# Dynamo custom node Adaptive Component On Face By Image.dyf
# category: Revit.Family Creation

U_count = Input()  # "U-count"
V_count = Input()  # "V-count"
formula = Formula("U*V+(U-1)", U=U_count, V=V_count, lacing=Longest)
Face = Input()
surface_domain = SurfaceDomain(Face)
uv_grid = UVGrid(surface_domain, U_count, V_count)
evaluate_uv = XYZEvaluate(uv_grid, Face, lacing=Longest)
number = DoubleInput(1)
number_2 = DoubleInput(1)
add = Addition(V_count, number_2, lacing=Longest)
formula_2 = Formula("V+1", V=add, lacing=Longest)
build_sublists = Sublists("0,V,x,1", evaluate_uv, number, add, formula_2, lacing=Longest)
take_from_list = TakeList(formula, build_sublists)
list = NewList(index0=take_from_list)
number_3 = DoubleInput(1)
subtract = Subtraction(V_count, number_3, lacing=Longest)
build_sublists_2 = Sublists("0..X", list, add, subtract, lacing=Longest)
number_4 = DoubleInput(2)
flatten = FlattenListAmt(build_sublists_2, number_4)
Family_Type = Input()
adaptive_component_by_points = AdaptiveComponentByPoints(flatten, Family_Type, lacing=Longest)
iParameter = Input()
Image_Path = Input()
read_image_file = ImageFileReader(Image_Path, U_count, V_count)
color_components = ColorComponents(read_image_file, lacing=Longest)
number_5 = DoubleInput(1)
subtract_2 = Subtraction(U_count, number_5, lacing=Longest)
build_sublists_3 = Sublists("0..X", color_components.out1, U_count, subtract_2, lacing=Longest)
transpose_lists = Transpose(build_sublists_3)
reverse = Reverse(transpose_lists)
flatten_2 = FlattenListAmt(reverse, number_5)
number_6 = DoubleInput(255)
Max_Value = Input()
divide = Division(number_6, Max_Value, lacing=Longest)
divide_2 = Division(flatten_2, divide, lacing=Longest)
set_family_instance_parameter = FamilyInstanceParameterSetter(adaptive_component_by_points, iParameter, divide_2, lacing=Longest)
fi = Output(set_family_instance_parameter)
