# Dynamo custom node Multiple PDF's Printer - Filter.dyf (Dynamo 1.3.2.2480)
# category: Ato9 Arquitetura

Views = Input()
categories = Categories("TitleBlocks")
all_elements_of_category = ElementsOfCategory(categories)
watch = Watch(all_elements_of_category)
code_block = CodeBlock { "Sheet Number"; }
getParameterValueByName = Element.GetParameterValueByName(element=Views, parameterName=code_block, lacing=Longest)
getParameterValueByName_2 = Element.GetParameterValueByName(element=all_elements_of_category, parameterName=code_block, lacing=Longest)
indexOf = IndexOf(getParameterValueByName_2, lacing=Longest)  # unwired: arg1
map = List.Map(list=getParameterValueByName, f_x=indexOf)
getItemAtIndex = List.GetItemAtIndex(list=watch, index=map)
string_from_object = FromObject(getItemAtIndex)
SearchFor = Input()
contains = String.Contains(str=string_from_object, searchFor=SearchFor)
filterByBoolMask = List.FilterByBoolMask(list=Views, mask=contains)
Views_2 = Output(filterByBoolMask.in)  # "Views"
element_types = ElementTypes("PrintSetting")
all_elements_of_type = ElementsOfType(element_types)
name = Element.Name(all_elements_of_type)
contains_2 = String.Contains(str=name, searchFor=SearchFor)
filterByBoolMask_2 = List.FilterByBoolMask(list=all_elements_of_type, mask=contains_2)
PrintSettings = Output(filterByBoolMask_2.in)
