# Dynamo custom node Layout.DistributionRange.dyf (Dynamo 1.2.0.2831)
# category: BIM4Struc.Rebar.Layout
# Defines the distribution ranges for rebar sets based on absolute or relative values.

# group: Input
ZoneSplitType = Input(ZoneSplitType:bool)  # Indicate whether the zone split values type True = relative values False = absolute values
ZoneLengths = Input(ZoneLengths:double[])  # A list of values indicating the length of each zone When the last value in the list equals -1, the last zone length will be calculated automatically.
TotalLength = Input(TotalLength:double)  # Total length of the zone to divide
# note: *****************************************************
# Defines the distribution ranges for rebar sets based on absolute or relative values.
# Authored by Dieter Vermeulen, Autodesk, 2016
# http://revitbeyondbim.wordpress.com
ZoneStart = Input(ZoneStart:double)  # The startposition of the first zone, as absolute value e.g. Cover + Half Diameter

# group: Calculating last item in Zone Split List for relative and absolute values
sum = Math.Sum(ZoneLengths)
code_block = CodeBlock(x=sum) { 1-(x+1); }
code_block_2 = CodeBlock(TotalLength=TotalLength, x=sum) { TotalLength-(x+1); }
if_ = If(test=ZoneSplitType, true=code_block, false=code_block_2)

# group: Replace last item with calculated (relative/absolute) value if equal to "-1".
lastItem = List.LastItem(ZoneLengths)
code_block_3 = CodeBlock { -1; }
eq = lastItem == code_block_3
code_block_4 = CodeBlock(a=ZoneLengths) { List.Count(a)-1; }
replaceItemAtIndex = List.ReplaceItemAtIndex(list=ZoneLengths, index=code_block_4, item=if_)
if_2 = If(test=eq, true=replaceItemAtIndex, false=ZoneLengths)

# group: Return absolute values for zone lengths
code_block_5 = CodeBlock(RelativeZones=if_2, TotalLength=TotalLength) { ZoneLengths=RelativeZones*TotalLength; }
if_3 = If(test=ZoneSplitType, true=code_block_5, false=if_2)

ZoneLengths_2 = Output(if_3)  # "ZoneLengths"

# group: Calculate start position of each zone, beginning at the start plane.
add = _ + _  # unwired: arg0, arg1
scan = ScanList(add, ZoneStart, if_3)  # "List.Scan"
code_block_6 = CodeBlock(lst=scan) { List.Count(lst)-1; }
removeItemAtIndex = List.RemoveItemAtIndex(list=scan, indices=code_block_6)
flatten = Flatten(removeItemAtIndex)

ZoneStartPositions = Output(flatten)
