# Dynamo custom node PathReinforcement.CreateByCurveAndShapeCode.dyf (Dynamo 1.2.0.2831)
# category: BIM4Struc.Rebar.Creation
# Create a path reinforcement based on a list of curves and a predefined Rebar Shape Code.

# group: Input
# note: *****************************************************
# Create a Path Reinforcement in Revit based on a list of curves and a predefined Rebar Shape Code.
# Authored by Dieter Vermeulen, Autodesk, 2016
# http://revitbeyondbim.wordpress.com
HostElement = Input(HostElement:Element)  # Select a Floor or Wall as host The sketch geometry of the floor or wall will be used as boundaries for the area
PathCurves = Input(PathCurves:DesignScript.Curve[])  # The Major Direction vector for the area reinforcement. By default the first sketch line of the Floor or Wall boundary is taken.
Flip = Input(Flip:bool=false)  # Toggle to flip the side of the path reinforcement
BarType = Input(BarType:Element)  # Rebar Bar Type
RebarStartHookType = Input(RebarStartHookType:Element)  # Rebar Start Hook Type
RebarEndHookType = Input(RebarEndHookType:Element)  # Rebar End Hook Type
RebarShape = Input(RebarShape:Element)  # Rebar Bar Shape

CreateNew = Input(CreateNew:bool=false)  # Create a new element for each run of Dynamo (true) or update the generated element (false)
create_path_reinforcement = Python(IN[0]=HostElement, IN[1]=PathCurves, IN[2]=Flip, IN[3]=BarType, IN[4]=RebarStartHookType, IN[5]=RebarEndHookType, IN[6]=RebarShape, IN[7]=CreateNew)
# ---------- create_path_reinforcement.python (63 lines) ----------
#Create path reinforcement based on curves and a rebar shape
#Authored by Dieter Vermeulen, Autodesk, 2016
#http://revitbeyondbim.wordpress.com

import clr

clr.AddReference('RevitAPI')
from Autodesk.Revit.DB import *
from Autodesk.Revit.DB.Structure import *

clr.AddReference("System")
from System.Collections.Generic import List

clr.AddReference('RevitNodes')
import Revit
clr.ImportExtensions(Revit.GeometryConversion)
clr.ImportExtensions(Revit.Elements)

clr.AddReference('RevitServices')
import RevitServices
from RevitServices.Persistence import DocumentManager
from RevitServices.Transactions import TransactionManager

doc = DocumentManager.Instance.CurrentDBDocument

#Preparing input from dynamo to revit
host = UnwrapElement(IN[0])
if type(IN[1])==list:
	curves=List[Curve]([c.ToRevitType(True) for c in IN[1]])
else:
	curves=[]
	curves.append(IN[1].ToRevitType(True))
flip=IN[2]
bartype = UnwrapElement(IN[3])
startRebarHookType = UnwrapElement(IN[4])
endRebarHookType = UnwrapElement(IN[5])
rebarShape = UnwrapElement(IN[6])

#Toggle that indicates if a new element has to be created
new=IN[7]

TransactionManager.Instance.EnsureInTransaction(doc)
# Get the host analytical profile whose curves will define the boundary of the the area reinforcement 
analytical = host.GetAnalyticalModel()
if not analytical:
    rebar= "The selected element can't \nhost Path Reinforcement"

else:  	
	#Obtain the default Path Reinforcement Type
	defaultPathReinforcementTypeId = doc.GetDefaultElementTypeId(ElementTypeGroup.PathReinforcementType)
	if str(defaultPathReinforcementTypeId) == "-1":
		rebar= "There is no Path Reinforcement Family Type \ndefined in the Revit project"
	else:
		try:
			rebar = PathReinforcement.Create(doc, host, curves, flip, defaultPathReinforcementTypeId, bartype.Id, startRebarHookType.Id, endRebarHookType.Id, rebarShape.Id).ToDSType(new);
		except:
			rebar= "The Path Reinforcement could \nnot be created"

#Assign your output to the OUT variable

TransactionManager.Instance.TransactionTaskDone()

OUT=rebar
# ----------------------------------------
end = Revit.Transaction.Transaction.End(create_path_reinforcement)
code_block = CodeBlock { "Primary Bar - Start Hook Type"; "Primary Bar - End Hook Type"; "Face"; "Primary Bar - Length"; "Bar Spacing"; }
create = List.Create(code_block.out0, code_block.out1, code_block.out2, code_block.out3, code_block.out4)
PlacementFace = Input(PlacementFace:int=0)  # Placement face in Floor or Wall 0 = Top 1 = Bottom
InputInMM = Input(InputInMM: bool = true)  # Input the value in mm (true) or feet (false)
BarLength = Input(BarLength:double)  # Length of the primary bars
formula = Formula("if(metric,x/304.8,x)", metric=InputInMM, x=BarLength)
BarSpacing = Input(BarSpacing:double)  # Primary Bar Spacing
formula_2 = Formula("if(metric,x/304.8,x)", metric=InputInMM, x=BarSpacing)
create_2 = List.Create(RebarStartHookType, RebarEndHookType, PlacementFace, formula, formula_2)
setParameterByName = Element.SetParameterByName(element=end, parameterName=create, value=create_2)
code_block_2 = CodeBlock(a=setParameterByName) { a[0]; }

# group: Error Catching
# note: If the Python node returns an error message (as a string) then this should be passed. Else the AreaReinforcement element can be passed.
# Checking if the output of the Python node has a value for Element.Id is a test for that.
id = Element.Id(end)
isNull = Object.IsNull(id)
if_ = If(test=isNull, true=end, false=code_block_2)

PathReinforcement = Output(if_)
