# Dynamo custom node PathReinforcement.GetRebar.dyf (Dynamo 1.2.0.2831)
# category: BIM4Struc.Rebar.QueryTools
# Get the Rebar objects hosted by a Path Reinforcment

# note: *****************************************************
# Get the rebar-in-system objects owned by a Path Reinforcement.
# Authored by Dieter Vermeulen, Autodesk, 2016
# http://revitbeyondbim.wordpress.com
PathReinforcement = Input(PathReinforcement:var[])  # Path Reinforcement
code_block = CodeBlock(lst=PathReinforcement) { Flatten({lst}); }
python_script = Python(IN[0]=code_block)
# ---------- python_script.python (42 lines) ----------
#Get Rebar-in-System objects woned by a Path Reinforcement.
#Authored by Dieter Vermeulen, Autodesk, 2016
#http://revitbeyondbim.wordpress.com

import clr
clr.AddReference('ProtoGeometry')
from Autodesk.DesignScript.Geometry import *
# Import ToDSType(bool) extension method
clr.AddReference("RevitNodes")
import Revit
clr.ImportExtensions(Revit.Elements)
# Import geometry conversion extension methods
clr.ImportExtensions(Revit.GeometryConversion)
# Import DocumentManager and TransactionManager
clr.AddReference("RevitServices")
import RevitServices
from RevitServices.Persistence import DocumentManager
from RevitServices.Transactions import TransactionManager
from System.Collections.Generic import *
# Import RevitAPI
clr.AddReference("RevitAPI")
import Autodesk
from Autodesk.Revit.DB import *

doc = DocumentManager.Instance.CurrentDBDocument
uiapp = DocumentManager.Instance.CurrentUIApplication
app = uiapp.Application

Rebar=[]
reb=[]

#get Host Family Instance

for i in IN[0]:
	pathReinf=UnwrapElement(i)
	ids=pathReinf.GetRebarInSystemIds()
	for id in ids:
		inst=doc.GetElement.Overloads[Autodesk.Revit.DB.ElementId](id).ToDSType(True)
		reb.append(inst)
	Rebar.append(reb)
		
OUT = Rebar
# ----------------------------------------
RebarElements = Output(python_script)
