# Dynamo custom node Perpendicular distribution.dyf (Dynamo 1.2.0.2831)
# category: BIM4Struc.Rebar.Curves
# Node that distributes curves along selected transversal curves (e.g. distribution of longitudinal rebar along transversal rebar segments.)

# note: *****************************************************
# Node that distributes perpendicular reinforcement centerlines (longitudinal) based on the center curve of transversal reinforcement (stirrup).
# Authored by Dieter Vermeulen, Autodesk, 2016
# http://revitbeyondbim.wordpress.com
ReferenceCurve = Input(ReferenceCurve:DesignScript.Curve)  # Reference curve representing the longitudinal curve that needs to be distributed along the transversal curve. This curve may not be parallel to the TransversalCurve.
TransversalCurve = Input(TransversalCurve:DesignScript.Curve)  # The transversal curve along which you want to distribute the longitudinal curves. This is generally a segment of the sketch line(s) of a selected rebar
DistanceAtStart = Input(DistanceAtStart:double)  # Perpendicular distance of the first longitudinal curve measured to the startpoint of the transversal curve (positive value means within the length of the line)
DistanceAtEnd = Input(DistanceAtEnd:double)  # Perpendicular distance of the last longitudinal curve measured to the end of the transversal curve (positive value means within the length of the line)
NumberOfLongitudinalCurves = Input(NumberOfLongitudinalCurves:int=2)  # The number of curves to distribute along the transversal curve
code_block = CodeBlock(DistAtStart=DistanceAtStart, crv=TransversalCurve, DistAtEnd=DistanceAtEnd, NrOfCurves=NumberOfLongitudinalCurves) { DistAtStart..crv.Length-DistAtEnd..#NrOfCurves; }
parameterAtSegmentLength = Curve.ParameterAtSegmentLength(TransversalCurve, code_block)
flatten = Flatten(parameterAtSegmentLength)
# note: Get the vector and normal plane characteristics at the distribution points
pointAtParameter = Curve.PointAtParameter(curve=TransversalCurve, param=flatten, lacing=Longest)
normalAtParameter = Curve.NormalAtParameter(curve=TransversalCurve, param=flatten, lacing=Longest)
byOriginNormal = Plane.ByOriginNormal(origin=pointAtParameter, normal=normalAtParameter)
code_block_2 = CodeBlock(a=byOriginNormal) { a[0]; }
# note: Get the reference point at the reference curve as an intersection of the plane which the transversal line is created in and the reference curve.
intersect = Geometry.Intersect(geometry=ReferenceCurve, other=code_block_2)
FlipSide = Input(FlipSide:bool=false)  # At which side of the transversal line the longitudinal one needs to be positioned Indicated by a boolean value
tangentAtParameter = Curve.TangentAtParameter(TransversalCurve, flatten)
code_block_3 = CodeBlock { 90; }
rotate = Vector.Rotate(normalAtParameter, tangentAtParameter, code_block_3, lacing=Longest)
reverse = Vector.Reverse(rotate)
# note: Get the distribution points where the longitudinal curves need to be positioned at
if_ = If(test=FlipSide, true=reverse, false=rotate)
offset = Input(offset:double=0)  # Offset between the transversal curve and the new longitudinal curve Traditionally this is the radius of the selected transversal rebar added with the radius of the newly to generate longitudinal rebar = center-to-center distance
translate = Geometry.Translate(geometry=pointAtParameter, direction=if_, distance=offset, lacing=Longest)
# note: Calculate the translation vector
byTwoPoints = Vector.ByTwoPoints(start=intersect, end=translate, lacing=Longest)
translate_2 = Geometry.Translate(geometry=ReferenceCurve, direction=byTwoPoints)
LongitudinalCurves = Output(translate_2)
