# Dynamo custom node Rebar.CopyByVector.dyf (Dynamo 1.2.0.2831)
# category: BIM4Struc.Rebar.Modify
# Copy a selected rebar object and copy it according to a list of vectors.

element = Input(element:Element[])
vector = Input(vector:Vector)
asPoint = Vector.AsPoint(vector)
python_script = Python(IN[0]=element, IN[1]=asPoint)
# ---------- python_script.python (34 lines) ----------
import clr
from System.Collections.Generic import *
clr.AddReference('RevitAPI')
from Autodesk.Revit.DB import *
import Autodesk

clr.AddReference("RevitNodes")
import Revit
clr.ImportExtensions(Revit.Elements)
clr.ImportExtensions(Revit.GeometryConversion)

clr.AddReference("RevitServices")
import RevitServices
from RevitServices.Persistence import DocumentManager
from RevitServices.Transactions import TransactionManager

doc = DocumentManager.Instance.CurrentDBDocument
items = UnwrapElement(IN[0])
xyz = UnwrapElement(IN[1]).ToXyz()

ids = list()
for item in items:
	ids.append(item.Id)	
itemlist = List[ElementId](ids)

TransactionManager.Instance.EnsureInTransaction(doc)
newitems = ElementTransformUtils.CopyElements(doc,itemlist,xyz)
TransactionManager.Instance.TransactionTaskDone()

elementlist = list()
for item in newitems:
	elementlist.append(doc.GetElement(item).ToDSType(False))

OUT = elementlist
# ----------------------------------------
NewElements = Output(python_script)
