# Dynamo custom node Rebar.GetFullGeometryForView.dyf (Dynamo 1.2.0.2831)
# category: BIM4Struc.Rebar.QueryTools
# Generates full geometry for the Rebar for a specific view.

rebar = Input(rebar : Element)
view = Input(view : View)
python_script = Python(IN[0]=rebar, IN[1]=view)
# ---------- python_script.python (21 lines) ----------
import clr

clr.AddReference('RevitAPI')
from Autodesk.Revit.DB import *
from Autodesk.Revit.DB.Structure import *

clr.AddReference('RevitNodes')
import Revit
clr.ImportExtensions(Revit.GeometryConversion)
clr.ImportExtensions(Revit.Elements)

clr.AddReference('RevitServices')
import RevitServices
from RevitServices.Persistence import DocumentManager


doc = DocumentManager.Instance.CurrentDBDocument
element = UnwrapElement(IN[0])
view = UnwrapElement(IN[1])

OUT = [e.ToProtoType(True) for e in element.GetFullGeometryForView(view)]
# ----------------------------------------
geometry = Output(python_script)
