# Dynamo custom node Rebar.SetDistributionType.dyf (Dynamo 1.2.0.2831)
# category: BIM4Struc.Rebar.Layout
# Toggle to set the distribution type of a rebar set to "Varying Length" (True) or "Uniform" (False)

# note: *****************************************************
# Toggle to set the distribution type of a rebar set to "Varying Length" (True) or "Uniform" (False).
# Authored by Dieter Vermeulen, Autodesk, 2016
# http://revitbeyondbim.wordpress.com
rebarElement = Input(rebarElement:Element)
DistributionType = Input(DistributionType:bool)  # Choose the distribution type True = Varying Length False = Uniform
python_script = Python(IN[0]=rebarElement, IN[1]=DistributionType)
# ---------- python_script.python (39 lines) ----------
#Sets the distribution type of a selected rebar
#Authored by Dieter Vermeulen, Autodesk, 2016
#http://revitbeyondbim.wordpress.com

import clr

clr.AddReference('RevitAPI')
from Autodesk.Revit.DB import *
from Autodesk.Revit.DB.Structure import *

clr.AddReference("System")
from System.Collections.Generic import List

clr.AddReference('RevitNodes')
import Revit
clr.ImportExtensions(Revit.GeometryConversion)
clr.ImportExtensions(Revit.Elements)

clr.AddReference('RevitServices')
import RevitServices
from RevitServices.Persistence import DocumentManager
from RevitServices.Transactions import TransactionManager

doc = DocumentManager.Instance.CurrentDBDocument

#Preparing input from dynamo to revit
rebarElement = UnwrapElement(IN[0])
distributionToggle=IN[1]

#Change rebar in transaction
TransactionManager.Instance.EnsureInTransaction(doc)
#Case "VaryingLength Distribution Type"
if distributionToggle==True:
	rebarElement.DistributionType=DistributionType.VaryingLength
else:
	rebarElement.DistributionType=DistributionType.Uniform
TransactionManager.Instance.TransactionTaskDone()

OUT = rebarElement
# ----------------------------------------
rebarElement_2 = Output(python_script)  # "rebarElement"
