# Dynamo custom node Rebar.SetLayoutAsFixedNumber.dyf (Dynamo 1.2.0.2831)
# category: BIM4Struc.Rebar.Layout
# Sets the Layout Rule property of rebar set to FixedNumber.

# note: *****************************************************
# Sets the Layout Rule property of rebar set to FixedNumber.
# Authored by Dieter Vermeulen, Autodesk, 2016
# http://revitbeyondbim.wordpress.com
rebarElement = Input(rebarElement:Element)
Quantity = Input(Quantity:int)  # The number of bar positions in rebar set
RebarSetLength = Input(RebarSetLength:double)  # The distribution length of rebar set
barsOnNormalSide = Input(barsOnNormalSide:bool=true)  # Identifies if the bars of the rebar set are on the same side of the rebar plane indicated by the normal
IncludeFirstBar = Input(IncludeFirstBar:bool=true)  # Identifies if the first bar in rebar set is shown
IncludeLastBar = Input(IncludeLastBar:bool=true)  # dentifies if the last bar in rebar set is shown
InputInMM = Input(InputInMM: bool = true)  # Input the value in mm (true) or feet (false)
python_script = Python(IN[0]=rebarElement, IN[1]=Quantity, IN[2]=RebarSetLength, IN[3]=barsOnNormalSide, IN[4]=IncludeFirstBar, IN[5]=IncludeLastBar, IN[6]=InputInMM)
# ---------- python_script.python (43 lines) ----------
#Sets the Layout Rule property of rebar set to FixedNumber.
#Authored by Dieter Vermeulen, Autodesk, 2016
#http://revitbeyondbim.wordpress.com

import clr

clr.AddReference('RevitAPI')
from Autodesk.Revit.DB import *
from Autodesk.Revit.DB.Structure import *

clr.AddReference("System")
from System.Collections.Generic import List

clr.AddReference('RevitNodes')
import Revit
clr.ImportExtensions(Revit.GeometryConversion)
clr.ImportExtensions(Revit.Elements)

clr.AddReference('RevitServices')
import RevitServices
from RevitServices.Persistence import DocumentManager
from RevitServices.Transactions import TransactionManager

doc = DocumentManager.Instance.CurrentDBDocument

#Preparing input from dynamo to revit
rebarElement = UnwrapElement(IN[0])
numberOfBarPositions = IN[1]
arrayLength = IN[2]
barsOnNormalSide = IN[3]
inclFirstBar=IN[4]
inclLastBar=IN[5]

#convert from mm to feet:
if IN[6]:
	arrayLength = arrayLength/304.8

#Change rebar in transaction
TransactionManager.Instance.EnsureInTransaction(doc)
rebarElement.SetLayoutAsFixedNumber(numberOfBarPositions,arrayLength,barsOnNormalSide,inclFirstBar,inclLastBar)
TransactionManager.Instance.TransactionTaskDone()

OUT = rebarElement
# ----------------------------------------
rebarElement_2 = Output(rebarElement)  # "rebarElement"
