# Dynamo custom node Rebar.SetLayoutAsSingle.dyf (Dynamo 1.2.0.2831)
# category: BIM4Struc.Rebar.Layout
# Sets the Layout Rule property of rebar set to Single.

# note: *****************************************************
# Sets the Layout Rule property of rebar set to Single.
# Authored by Dieter Vermeulen, Autodesk, 2016
# http://revitbeyondbim.wordpress.com
rebarElement = Input(rebarElement:Element)
python_script = Python(IN[0]=rebarElement)
# ---------- python_script.python (34 lines) ----------
#Sets the Layout Rule property of rebar set to Single..
#Authored by Dieter Vermeulen, Autodesk, 2016
#http://revitbeyondbim.wordpress.com

import clr

clr.AddReference('RevitAPI')
from Autodesk.Revit.DB import *
from Autodesk.Revit.DB.Structure import *

clr.AddReference("System")
from System.Collections.Generic import List

clr.AddReference('RevitNodes')
import Revit
clr.ImportExtensions(Revit.GeometryConversion)
clr.ImportExtensions(Revit.Elements)

clr.AddReference('RevitServices')
import RevitServices
from RevitServices.Persistence import DocumentManager
from RevitServices.Transactions import TransactionManager

doc = DocumentManager.Instance.CurrentDBDocument

#Preparing input from dynamo to revit
rebarElement = UnwrapElement(IN[0])

#Change rebar in transaction
TransactionManager.Instance.EnsureInTransaction(doc)
rebarElement.SetLayoutAsSingle()
TransactionManager.Instance.TransactionTaskDone()

OUT = rebarElement
# ----------------------------------------
rebarElement_2 = Output(rebarElement)  # "rebarElement"
