# Dynamo custom node Split curve with overlap.dyf (Dynamo 1.2.0.2831)
# category: BIM4Struc.Rebar.Curves
# Splits a curve into multiple segments with a maximum length and a gap between two consecutive ones, and create a second curve next to it with similar division and overlap.
# This node is to prepare rebars centerlines with splice lengths.

# note: *****************************************************
# Split a given curve according to max lengths and create an overlap. This is used for rebar fabrication creation.
# Authored by Dieter Vermeulen, Autodesk, 2016
# http://revitbeyondbim.wordpress.com
CurveToSplit = Input(CurveToSplit:var)  # Curve to split in constructable lengths
length = Curve.Length(CurveToSplit)
MaximumLength = Input(MaximumLength:double)  # The maximum length for each splitted curve
le = length <= MaximumLength
filterByBoolMask = List.FilterByBoolMask(list=CurveToSplit, mask=le)
code_block = CodeBlock(a=filterByBoolMask.out) { a[0]; }
length_2 = Curve.Length(code_block)
OverlapLength = Input(OverlapLength:double)  # The overlap length (splice length) for the second row
first_line_second_line_boolean = BoolSelector(true)
python_script = Python(IN[0]=length_2, IN[1]=MaximumLength, IN[2]=OverlapLength, IN[3]=first_line_second_line_boolean)
# ---------- python_script.python (49 lines) ----------
#Calculate the segment lengths for curve splitting with overlap
#Authored by Dieter Vermeulen, Autodesk, 2016
#http://revitbeyondbim.wordpress.com

import clr
import math
clr.AddReference('ProtoGeometry')
from Autodesk.DesignScript.Geometry import *
clr.AddReference("RevitAPIUI")
from Autodesk.Revit.UI import TaskDialog

#The inputs to this node will be stored as a list in the IN variables.
TotalLength=IN[0]
MaxLength=IN[1];
OverlapLength=IN[2];
FirstLine=IN[3];
#Calculate the length of gap between full curves. Gap covered by second line curves.
DiffLength=MaxLength-2*OverlapLength

segments=[]

#Verify the inputs

if MaxLength < OverlapLength:
		msgBox=TaskDialog
		segments=msgBox.Show("Error when spliting lines", "The maximum allowable length is smaller than the overlap length")
else:
	#In case of First Line division, then start at 1st segment (segment = 0)
	if FirstLine:
		segment=0
		rest=TotalLength
	#In case of Second Line division, then start 2nd segment taking overlap into account
	else:
		segment=MaxLength-OverlapLength
		rest=TotalLength-segment
		segments.append(segment)
	
	#Calculation of segment lengths
	while rest >= MaxLength:
		segment=segment+MaxLength
		segments.append(segment)
		rest=TotalLength-segment
		if rest > MaxLength:
			segment=segment+DiffLength
			segments.append(segment)
			rest=TotalLength-segment
	
#Assign your output to the OUT variable.
OUT = segments
# ----------------------------------------
parameterAtSegmentLength = Curve.ParameterAtSegmentLength(code_block, python_script)
splitByParameter = Curve.SplitByParameter(code_block, parameterAtSegmentLength)
code_block_2 = CodeBlock { 2; -1; }
takeEveryNthItem = List.TakeEveryNthItem(splitByParameter, code_block_2.out0, code_block_2.out1)
create = List.Create(filterByBoolMask.in, takeEveryNthItem)
flatten = Flatten(create)
FirstRowCurves = Output(flatten)
DirectionSecondRow = Input(DirectionSecondRow:var[])  # The direction for the translation to the second row of splitted curves overlapping the first row
DistanceSecondRow = Input(DistanceSecondRow:double)  # The distance between the first row and second overlapping row of curves
translate = Geometry.Translate(geometry=filterByBoolMask.out, direction=DirectionSecondRow, distance=DistanceSecondRow)
code_block_3 = CodeBlock(a=translate) { a[0]; }
length_3 = Curve.Length(code_block_3)
first_line_second_line_boolean_2 = BoolSelector(false)
python_script_2 = Python(IN[0]=length_3, IN[1]=MaximumLength, IN[2]=OverlapLength, IN[3]=first_line_second_line_boolean_2)
# ---------- python_script_2.python (48 lines) ----------
#Calculate the segment lengths for curve splitting with overlap
#Authored by Dieter Vermeulen, Autodesk, 2016
#http://revitbeyondbim.wordpress.com

import clr
import math
clr.AddReference('ProtoGeometry')
from Autodesk.DesignScript.Geometry import *
clr.AddReference("RevitAPIUI")
from Autodesk.Revit.UI import TaskDialog

#The inputs to this node will be stored as a list in the IN variables.
TotalLength=IN[0]
MaxLength=IN[1];
OverlapLength=IN[2];
FirstLine=IN[3];
#Calculate the length of gap between full curves. Gap covered by second line curves.
DiffLength=MaxLength-2*OverlapLength

segments=[]

#Verify the inputs
if MaxLength < OverlapLength:
		msgBox=TaskDialog
		segments=msgBox.Show("Error when spliting lines", "The maximum allowable length is smaller than the overlap length")
else:
#In case of First Line division, then start at 1st segment (segment = 0)
	if FirstLine:
		segment=0
		rest=TotalLength
#In case of Second Line division, then start 2nd segment taking overlap into account
	else:
		segment=MaxLength-OverlapLength
		rest=TotalLength-segment
		segments.append(segment)
	
#Calculation of segment lengths
	while rest >= MaxLength:
		segment=segment+MaxLength
		segments.append(segment)
		rest=TotalLength-segment
		if rest > MaxLength:
			segment=segment+DiffLength
			segments.append(segment)
			rest=TotalLength-segment
	
#Assign your output to the OUT variable.
OUT = segments
# ----------------------------------------
parameterAtSegmentLength_2 = Curve.ParameterAtSegmentLength(code_block_3, python_script_2)
splitByParameter_2 = Curve.SplitByParameter(code_block_3, parameterAtSegmentLength_2)
code_block_4 = CodeBlock { 2; 0; }
takeEveryNthItem_2 = List.TakeEveryNthItem(splitByParameter_2, code_block_4.out0, code_block_4.out1)
SecondRowCurves = Output(takeEveryNthItem_2)
