# Dynamo custom node Trim curves by Surfaces.dyf (Dynamo 1.3.0.875)
# category: BIM4Struc.Rebar.Curves
# Trim curves by 2 faces and keep the internal part.

# note: *****************************************************
# Trim curves by 2 faces and keep the internal part.
# Authored by Dieter Vermeulen, Autodesk, 2016
# http://revitbeyondbim.wordpress.com
CurvesToTrim = Input(CurvesToTrim:DesignScript.Curve[])  # Curve to be trimmed
SwitchSide = Input(SwitchSide:bool=false)  # Switch sides (internal or external)
Surface2 = Input(Surface2:DesignScript.Surface)  # Select the end surface
Surface1 = Input(Surface1:DesignScript.Surface)  # Select the start surface
if_ = If(test=SwitchSide, true=Surface2, false=Surface1)
split = Geometry.Split(geometry=CurvesToTrim, other=if_)
flatten = Flatten(split)
code_block = CodeBlock { 2; -1; }
takeEveryNthItem = List.TakeEveryNthItem(flatten, code_block.out0, code_block.out1)
if_2 = If(test=SwitchSide, true=Surface1, false=Surface2)
split_2 = Geometry.Split(geometry=takeEveryNthItem, other=if_2)
flatten_2 = Flatten(split_2)
code_block_2 = CodeBlock { 2; 0; }
takeEveryNthItem_2 = List.TakeEveryNthItem(flatten_2, code_block_2.out0, code_block_2.out1)
TrimmedCurves = Output(takeEveryNthItem_2)
