# Dynamo graph Set Rebar Solid in View.dyn (Dynamo 1.2.0.2831)

categories = Categories("Rebar")
all_elements_of_category = ElementsOfCategory(categories)
current = Document.Current()
activeView = Document.ActiveView(current)
boolean = BoolSelector(true)
setSolidInView = Custom[Rebar.SetSolidInView](rebarElements=all_elements_of_category, views=activeView, solid=boolean)  # Sets this rebar element to be shown solidly in a 3D view.
