# Dynamo graph Set Rebar Unobscured in View.dyn (Dynamo 1.2.0.2831)

categories = Categories("Rebar")
all_elements_of_category = ElementsOfCategory(categories)
current = Document.Current()
activeView = Document.ActiveView(current)
boolean = BoolSelector(true)
setUnobscuredInView = Custom[Rebar.SetUnobscuredInView](rebarElements=all_elements_of_category, views=activeView, unobscured=boolean)  # Sets this rebar element to be shown unobscured in a view.
