# Dynamo custom node BIMflow Room Numbering.dyf (Dynamo 1.3.2.2480)
# category: BIMflow Nodes
# Set numbers for rooms, it works in the rooms in active view or selected rooms, with flixibility in numbering system,
# how it works:
# in Revit, draw lines from left to right, and from up to down,
# select the lines and select the rooms
# select the setting you want and hit run

Select_Rooms_Model_Elements = Input()  # "Select Rooms (Model Elements)"
Select_Lines_Model_Elements = Input()  # "Select Lines (Model Elements)"
Level_Code_String = Input()  # "Level Code (String)"
Separator_String = Input()  # "Separator (String)"
Start_From_Number = Input()  # "Start From (Number)"
code_block = CodeBlock(Select_Rooms_Model_Elements, Select_Lines_Model_Elements, Level_Code_String, Separator_String, Start_From_Number)
# ---------- code_block.designscript (39 lines) ----------
t6 = t7.Geometry();
t8 = DSCore.List.IsEmpty(t6<1L>);
t9 = DSCore.List.FilterByBoolMask(t7, t8);
t10 = __TryGetValueFromNestedDictionaries(t9, "in");
t11 = __TryGetValueFromNestedDictionaries(t9, "out");
t12 = t13.Geometry();
t14 = Flatten(t12);
point1 = t14.EndPoint;
point2 = t14.StartPoint;
t15 = DSCore.List.RestOfItems(point2);
line1 = Line.ByStartPointEndPoint(point1, t15);
t16 = DSCore.List.Join({t14, line1});
polyCurve1 = PolyCurve.ByJoinedCurves(t16);
t17 = Flatten(t6);
geometry1 = t17<1>.Intersect(t14<2>);
t18 = Flatten(geometry1<1L>);
point3 = t18.StartPoint;
t19 = polyCurve1.ParameterAtPoint(point3);
t20 = SortIndexByValue(t19<1L>);
t21 = DSCore.List.FirstItem(t20<1L>);
t22 = DSCore.List.GetItemAtIndex(point3<1L>, t21<1L>);
t23 = polyCurve1.ParameterAtPoint(t22);
t24 = SortIndexByValue(t23);
t25 = DSCore.List.GetItemAtIndex(t11, t24);
t5 = "Number";
t26 = Count(t20);
t27 = DSCore.List.OfRepeatedItem(t28, t26);
t29 = t25.GetParameterValueByName("Level");
t30 = String.Split(t29, {" "});
t31 = DSCore.List.LastItem(t30<1L>);
t32 = {t27, t31};
t33 = DSCore.List.Transpose(t32);
t34 = String.Concat({t33});
t35 = Flatten(t34);
t37 = DSCore.List.OfRepeatedItem(t36, t26);
t3 = "0";
a = t38;
b = t26;
t1 = (a..(b + a) - 1);
# ----------------------------------------
Include_Level_name_Boolean = Input()  # "Include Level name (Boolean)"
Add_level_Code_Boolean = Input()  # "Add level Code (Boolean)"
if_ = If(test=Add_level_Code_Boolean, true=code_block.t35, false=code_block.t29)
Add_Zeros_to_Start_Boolean = Input()  # "Add Zeros to Start (Boolean)"
string_from_object = FromObject(code_block.t1)
code_block_2 = CodeBlock(string_from_object, code_block.t3)
# ---------- code_block_2.designscript (13 lines) ----------
t2 = DSCore.List.LastItem(t3);
t4 = String.Length(t2);
t5 = String.Length(t3);
a = t4;
b = t5;
t1 = a - b;
t6 = DSCore.List.OfRepeatedItem(t7<1L>, t1<1L>);
t8 = String.Concat({t6});
t9 = Flatten(t8);
t10 = {t9, t3};
t11 = DSCore.List.Transpose(t10);
t12 = String.Concat({t11});
t13 = Flatten(t12);
# ----------------------------------------
if_2 = If(test=Add_Zeros_to_Start_Boolean, true=code_block_2.t13, false=string_from_object)
code_block_3 = CodeBlock(t2=if_, t3=code_block.t37, t4=if_2) { t1 = {t2, t3, t4}; t5 = DSCore.List.Transpose(t1); t6 = String.Concat({t5}); t7 = Flatten(t6); }
if_3 = If(test=Include_Level_name_Boolean, true=code_block_3.t7, false=if_2)
setParameterByName = Element.SetParameterByName(element=code_block.t25, parameterName=code_block.t5, value=if_3)
Element = Output(setParameterByName)
