# Dynamo custom node Generate Web Page - Google Bar Chart.dyf (Dynamo 1.3.1.1736)
# category: BIMxHTML
# Generate HTML code for a web page to display a bar chart using Google Charts.

# group: Set external CSS
string = StringInput("https://maxcdn.bootstrapcdn.com/bootstrap/3.3.7/css/bootstrap.min.css")
create = List.Create(string)

# group: Set external javascript
string_2 = StringInput("https://ajax.googleapis.com/ajax/libs/jquery/3.2.0/jquery.min.js")
string_3 = StringInput("https://maxcdn.bootstrapcdn.com/bootstrap/3.3.7/js/bootstrap.min.js")
string_4 = StringInput("https://www.gstatic.com/charts/loader.js")
string_5 = StringInput("https://rawgit.com/louisremi/jquery-smartresize/master/jquery.throttledresize.js")
string_6 = StringInput("https://www.google.com/jsapi?ext.js")
create_2 = List.Create(string_2, string_3, string_4, string_5, string_6)

string_7 = StringInput("""<script type="text/javascript">

google.charts.load('current', {'packages':['bar']});

google.charts.setOnLoadCallback(drawChart);

google.setOnLoadCallback(initChart);

$(window).on("throttledresize", function (event) {
    initChart();
});




""")
string_8 = StringInput("""function initChart() {
    var options = {""")
options = Input(options : string = "width: '100%', height: '100%', legend: {position: 'bottom'}, pieSliceText: 'percentage', chartArea: {left: '3%',top: '3%', height: '94%', width: '94%'}")  # Additional options. Refer to Google Charts documentation
string_9 = StringInput("    };")
string_10 = StringInput("\nvar data = google.visualization.arrayToDataTable([")
items = Input(items : string[][])  # List of sublists containing key, value pairs
python_add_js_rows = Python(IN[0]=items)
# ---------- python_add_js_rows.python (14 lines) ----------
import clr
clr.AddReference('ProtoGeometry')
from Autodesk.DesignScript.Geometry import *
#The inputs to this node will be stored as a list in the IN variables.
dictIn = IN[0]

javaScript = "['Family Type','Quantity'],\n"

for index, i in enumerate(dictIn):
	#javaScript += "\t'" + str(dictIn[index]) + "',\n"
	javaScript += "['" + dictIn[index][0] + "'," + dictIn[index][1] + "],\n"
javaScript = javaScript[:-2]
#Assign your output to the OUT variable.
OUT = javaScript
# ----------------------------------------
watch = Watch(python_add_js_rows)
string_11 = StringInput("""
    ]);
    drawChart(data, options)
}

function drawChart(data, options) {

var chart = new google.charts.Bar(document.getElementById('chart'));

chart.draw(data, google.charts.Bar.convertOptions(options));

}
</script>""")
concat = String.Concat(string_7, string_8, options, string_9, string_10, watch, string_11)
string_12 = StringInput("""
<style>
#chart_wrap {
    position: relative;
    padding-bottom: 100%;
    overflow:hidden;
}
#chart {
    position: absolute;
    top: 0;
    left: 0;
    width:100%;
    height:100%;
}
</style>""")
concat_2 = String.Concat(concat, string_12)
string_13 = StringInput("""<div id="chart_wrap"><div id="chart"></div></div>
<p id="canvas_size"></p>""")

# group: Write HTML
generate_web_page = Custom[Generate Web Page](stylesheetSrc=create, javaScriptSrc=create_2, embeddedHeadCode=concat_2, content=string_13)  # Creates a static web page from a string formatted as HTML.

html = Output(generate_web_page)  # "html : string"; HTML output to be written to a file
watch_2 = Watch(concat)
code_block = CodeBlock {  }
