# Dynamo graph BOP-Pipe.dyn (Dynamo 0.8.1.1942)

element_types = ElementTypes("Pipe")
all_elements_of_type = ElementsOfType(element_types)
string = StringInput("BOP Pipe")
string_2 = StringInput("Offset")
getParameterValueByName = Element.GetParameterValueByName(element=all_elements_of_type, parameterName=string_2)
string_3 = StringInput("Outside Diameter")
getParameterValueByName_2 = Element.GetParameterValueByName(element=all_elements_of_type, parameterName=string_3)
convert_between_units = DynamoConvert(getParameterValueByName_2, conversionMetric=Length, conversionFrom=Feet, conversionTo=Millimeters)
code_block = CodeBlock(PipeDiameter=convert_between_units) { PipeDiameter/2; }
sub = getParameterValueByName - code_block
setParameterByName = Element.SetParameterByName(element=all_elements_of_type, parameterName=string, value=sub)
