# Dynamo graph BOP.dyn (Dynamo 0.9.0.3067)

element_types = ElementTypes("Pipe")
all_elements_of_type = ElementsOfType(element_types)
string = StringInput("BOP")
string_2 = StringInput("Offset")
getParameterValueByName = Element.GetParameterValueByName(element=all_elements_of_type, parameterName=string_2)
string_3 = StringInput("Outside Diameter")
getParameterValueByName_2 = Element.GetParameterValueByName(element=all_elements_of_type, parameterName=string_3)
convert_between_units = DynamoConvert(getParameterValueByName_2, conversionMetric=Length, conversionFrom=Feet, conversionTo=Millimeters)
number = DoubleInput(2)
div = convert_between_units / number
sub = getParameterValueByName - div
setParameterByName = Element.SetParameterByName(element=all_elements_of_type, parameterName=string, value=sub)
