# Dynamo custom node BS.Rebar.LabSplice.dyf (Dynamo 1.2.1.3083)
# category: BimSolutions
# Create rebar set with lapsplice based on original rebar set.

Choose_rebar = Input()
boundingBox = Element.BoundingBox(Choose_rebar)
getCenterlineCurve = Custom[Rebar.GetCenterlineCurve](Rebars=Choose_rebar)  # Get the centerline curves from a selected set of rebars
curves = PolyCurve.Curves(getCenterlineCurve)
flatten = Flatten(curves)
code_block = CodeBlock { {0,1}; }
pointAtParameter = Curve.PointAtParameter(curve=flatten, param=code_block, lacing=CrossProduct)
flatten_2 = Flatten(pointAtParameter)
code_block_2 = CodeBlock(x=flatten_2) { x[0]; x[1]; }
byStartPointEndPoint = Line.ByStartPointEndPoint(startPoint=code_block_2.out0, endPoint=code_block_2.out1)
MaximumLength = Input(MaximumLength : double=12000)
lapSplice = Input(lapSplice : double=1000)
direction = Line.Direction(byStartPointEndPoint)
ZAxis = Vector.ZAxis()
code_block_3 = CodeBlock { 90; }
rotate = Vector.Rotate(direction, ZAxis, code_block_3)
getProperties = Custom[Rebar.GetProperties](Rebars=Choose_rebar)  # Get the main properties of a selected array of rebars: Style, Bar Type, Hook Type, Hook Orientation.
getBarDiameter = Custom[RebarType.GetBarDiameter](rebarBarType=getProperties.Rebar_Bar_Type)  # Get the diameter of a given Rebar Bar Type
split_curve_with_overlap = Custom[Split curve with overlap](CurveToSplit=byStartPointEndPoint, MaximumLength=MaximumLength, OverlapLength=lapSplice, DirectionSecondRow=rotate, DistanceSecondRow=getBarDiameter)  # Splits a curve into multiple segments with a maximum length and a gap between two consecutive ones, and create a second curve next to it with similar division and overlap. This node is to prepare rebars centerlines with splice lengths.
code_block_4 = CodeBlock(a=split_curve_with_overlap.FirstRowCurves, b=split_curve_with_overlap.SecondRowCurves) { {a,b}; }
flatten_3 = Flatten(code_block_4)
map = List.Map(list=flatten_3)  # unwired: f_x
code_block_5 = CodeBlock(x=map) { x[0]; }
code_block_6 = CodeBlock { 10; 200; }
setLayoutAsNumberWithSpacing = Custom[Rebar.SetLayoutAsNumberWithSpacing](rebarElement=code_block_5, Quantity=code_block_6.out0, Spacing=code_block_6.out1)  # Sets the Layout Rule property of rebar set to NumberWithSpacing
boundingBox_2 = Element.BoundingBox(setLayoutAsNumberWithSpacing)
minPoint = BoundingBox.MinPoint(boundingBox_2)
maxPoint = BoundingBox.MaxPoint(boundingBox_2)
byCorners = Cuboid.ByCorners(lowPoint=minPoint, highPoint=maxPoint)
centroid = Solid.Centroid(byCorners)
width = Cuboid.Width(byCorners)
length = Cuboid.Length(byCorners)
code_block_7 = CodeBlock { 1000; }
byLengths = Cuboid.ByLengths(origin=centroid, width=width, length=length, height=code_block_7)
centroid_2 = Solid.Centroid(byLengths)
contains = BoundingBox.Contains(boundingBox, centroid_2)
code_block_8 = CodeBlock(a=contains, b=setLayoutAsNumberWithSpacing) { a; b; }
eraser = Custom[Tool.Eraser](List=code_block_8.b)  # Try to delete any element from project
code_block_9 = CodeBlock { "Quantity"; }
getParameterValueByName = Element.GetParameterValueByName(element=Choose_rebar, parameterName=code_block_9)
code_block_10 = CodeBlock { "Spacing"; }
getParameterValueByName_2 = Element.GetParameterValueByName(element=Choose_rebar, parameterName=code_block_10)
convert_between_units = DynamoConvert(getParameterValueByName_2, conversionMetric=Length, conversionFrom=Feet, conversionTo=Millimeters)
code_block_11 = CodeBlock { true; }
setLayoutAsNumberWithSpacing_2 = Custom[Rebar.SetLayoutAsNumberWithSpacing](Quantity=getParameterValueByName, Spacing=convert_between_units, barsOnNormalSide=code_block_8.a, IncludeFirstBar=code_block_11, IncludeLastBar=code_block_11, InputInMM=code_block_11)  # unwired: rebarElement
map_2 = List.Map(list=map, f_x=setLayoutAsNumberWithSpacing_2)
code_block_12 = CodeBlock(a=map_2, b=Choose_rebar) { a; b; }
eraser_2 = Custom[Tool.Eraser](List=code_block_12.b)
byCurve = Rebar.ByCurve()  # unwired: arg0, arg1, arg2, arg3, arg4, arg5, arg6, arg7, arg8
getHost = Custom[Rebar.GetHost](Rebars=Choose_rebar)  # Get the family instance and ID from the host of the selected rebar.
id = Element.Id(getHost.Elements)
code_block_13 = CodeBlock(a=convert_between_units) { a*1; }
Output = Output(code_block_12.a)  # ""
