# Dynamo custom node Add Prefix_Suffix to Family (BattleBIM).dyf (Dynamo 1.2.1.3083)
# category: BattleBIM.Revit.Modify.Rename
# This custom node will allow you to add Prefix & Suffix to Family

reset = Input(reset : bool=true)

# group: Add Prefix_Suffix to Family
get_family_list_for_this_project = Custom[Get Family List for this project](reset=reset)
element_name_battlebim = Custom[Element.Name(BattleBIM)](elements=get_family_list_for_this_project, reset=reset)  # This custom node will return name of the element

runMe = Input(runMe : bool=false)  # Set True for execute command
pref = Input(pref:string="")  # Prefix
suff = Input(suff:string="")  # Suffix
code_block = CodeBlock(pref=pref, rootWord=element_name_battlebim, suff=suff) { pref+rootWord+suff; }
code_block_2 = CodeBlock(runMe, code_block)
# ---------- code_block_2.designscript (11 lines) ----------
runMe;
name;

[Imperative]
{
if (runMe==true)
 return = name;
else
 return = null;

};
# ----------------------------------------

# group (continued): Add Prefix_Suffix to Family
setName = Custom[Element.SetName](element=get_family_list_for_this_project, name=code_block_2.out2, reset=reset)  # Gets the name of a given Revit element

Success = Output(setName.Success)
Fail = Output(setName.Fail)
