# Dynamo custom node Add Prefix_Suffix to FamilyTypesComponentFamily (BattleBIM).dyf "Add Prefix_Suffix to FamilyTypes | ComponentFamily (BattleBIM)" (Dynamo 1.3.0.875)
# category: BattleBIM.Revit.Modify.Rename
# This custom node will allow you to add Prefix & Suffix to Family Types of Component Family

reset = Input(reset : bool=true)
get_family_list_for_this_project = Custom[Get Family List for this project](reset=reset)

# group: Add Prefix_Suffix to FamilyTypes|ComponentFamily
types = Family.Types(get_family_list_for_this_project)
flatten = Flatten(types)
element_name_battlebim = Custom[Element.Name(BattleBIM)](elements=flatten, reset=reset)  # This custom node will return name of the element

runMe = Input(runMe : bool=false)  # Set True for execute command
pref = Input(pref:string="")  # Prefix
suff = Input(suff:string="")  # Suffix
code_block = CodeBlock(pref=pref, rootWord=element_name_battlebim, suff=suff) { pref+rootWord+suff; }
code_block_2 = CodeBlock(runMe, code_block)
# ---------- code_block_2.designscript (11 lines) ----------
runMe;
name;

[Imperative]
{
if (runMe==true)
 return = name;
else
 return = null;

};
# ----------------------------------------

# group (continued): Add Prefix_Suffix to FamilyTypes|ComponentFamily
setName = Custom[Element.SetName](element=flatten, name=code_block_2.out2, reset=reset)  # Gets the name of a given Revit element **Forks

Success = Output(setName.Success)
Fail = Output(setName.Fail)
