# Dynamo custom node Color_Color.Rainbow.dyf "Color.Rainbow(BattleBIM)" (Dynamo 1.3.0.875)
# category: BattleBIM.Color.Create
# Color.Rainbow(BattleBIM)

AlphaValue = Input(AlphaValue: int=255)
numOfGeometry = Input(numOfGeometry : int = 1)
code_block = CodeBlock(a=AlphaValue, num=numOfGeometry)
# ---------- code_block.designscript (10 lines) ----------
r=Color.ByARGB(a,255,0,0);
o=Color.ByARGB(a,255,128,0);
y=Color.ByARGB(a,255,255,0);
g=Color.ByARGB(a,0,255,0);
b=Color.ByARGB(a,0,128,255);
i=Color.ByARGB(a,0,0,255);
v=Color.ByARGB(a,127,0,255);
colors={r,o,y,g,b,i,v};
0..1..#7;
0..1..#num;
# ----------------------------------------
colors = Output(code_block.colors)
indices = Output(code_block.out8)
value = Output(code_block.out9)
