# Dynamo custom node Color_RGBtoHEX.dyf "RGBtoHEXtoRGB(BattleBIM)" (Dynamo 1.3.0.875)
# category: BattleBIM.Color.Actions
# This Custom node will Convert RGB value to HEX
# and HEX to RGB value

RGBValue = Input(RGBValue="255,255,255")  # Example 255,255,255
python_script = Python(IN[0]=RGBValue)
# ---------- python_script.python (15 lines) ----------
#Copyright © 2016, Lingkon
# @Lingkon, lingkonn@gmail.com
###############################
import clr
clr.AddReference('ProtoGeometry')
from Autodesk.DesignScript.Geometry import *
#The inputs to this node will be stored as a list in the IN variables.
dataEnteringNode = IN
text=str(IN[0])
x=text.replace('{', '')
y=x.replace('}', '')
x=text.replace(']', '')
y=x.replace('[', '')
#Assign your output to the OUT variable.
OUT=y
# ----------------------------------------
reset = Input(reset:bool = true)
python_script_2 = Python(IN[0]=python_script, IN[1]=reset)
# ---------- python_script_2.python (19 lines) ----------
#Copyright © 2016, Lingkon
# @Lingkon, lingkonn@gmail.com
###############################

import clr
clr.AddReference('ProtoGeometry')
from Autodesk.DesignScript.Geometry import *
#The inputs to this node will be stored as a list in the IN variables.
dataEnteringNode = IN
val=IN[0]
def int_to_hex_color(v):
    assert(len(v) == 3)
    return '#%02x%02x%02x' % v
import sys
sys.path.append(r'C:\Program Files (x86)\IronPython 2.7\Lib')
import ast
x=ast.literal_eval(val)
#Assign your output to the OUT variable.
OUT=int_to_hex_color((x))
# ----------------------------------------
HEX = Output(python_script_2)  # Sample #FFFFFF
HEXValue = Input(HEXValue="#FFFFFF")  # Example #FFFFFF
python_script_3 = Python(IN[0]=HEXValue, IN[1]=reset)
# ---------- python_script_3.python (16 lines) ----------
#Modified by Lingkon for BattleBIM
#Copyright © 2017, Lingkon
#@Lingkon, lingkonn@gmail.com
#Source code" https://stackoverflow.com/questions/214359/converting-hex-color-to-rgb-and-vice-versa"
###############################
hex = IN[0]
def hex_to_rgb(value):
    """Return (red, green, blue) for the color given as #rrggbb."""
    value = value.lstrip('#')
    lv = len(value)
    return tuple(int(value[i:i + lv // 3], 16) for i in range(0, lv, lv // 3))

text = str(hex_to_rgb(hex))
x=text.replace('(', '')
y=x.replace(')', '')
OUT = y
# ----------------------------------------
RGB = Output(python_script_3)  # Sample 255,255,255
