# Dynamo custom node Color_Random Color (BattleBIM).dyf "Random Color (BattleBIM)" (Dynamo 1.3.0.875)
# category: BattleBIM.Color.Create
# This custom node will generate random color

code_block = CodeBlock()
# ---------- code_block.designscript (4 lines) ----------
//Generating random color based on integer
def randomColor(x){
return = DSCore.Color.ByARGB(255,randomInt(),randomInt(),randomInt());
};
# ----------------------------------------
code_block_2 = CodeBlock()
# ---------- code_block_2.designscript (4 lines) ----------
//Generating random integer
def randomInt(){
return = Math.Random(0,255);
};
# ----------------------------------------
# note: Thanks to Dimitar
list = Input(list : var[]..[])  # Accept list of geometry e.g 0..50
flatten = Flatten(list)
code_block_3 = CodeBlock(geo=flatten) { randomColor(geo); }
Colors = Output(code_block_3)
