# Dynamo custom node Conversion_Base64ToString.dyf "Base64ToString (BattleBIM)" (Dynamo 1.3.0.875)
# category: BattleBIM.Conversion.base64.Create
# Convert base64 to String

base64 = Input(base64:string)
reset = Input(reset:bool = true)
python_script = Python(IN[0]=base64, IN[1]=reset)
# ---------- python_script.python (11 lines) ----------
#Copyright © 2016, Lingkon
# @Lingkon, lingkonn@gmail.com
###############################
import sys
sys.path.append(r'C:\Program Files (x86)\IronPython 2.7\Lib')
import base64
Bcode = IN[0]#base64 string
st = base64.b64decode(Bcode)

#Assign your output to the OUT variable.
OUT = st
# ----------------------------------------
str = Output(python_script)
