# Dynamo custom node Conversion_BytesToGB_MB.dyf "BytesToGB_MB (BattleBIM)" (Dynamo 1.3.0.875)
# category: BattleBIM.Conversion.Create
# Convert Bytes to GB & MB

IN_0 = Input()  # "IN[0]"
string_from_object = FromObject(IN_0)
reset = Input(reset:bool = true)
python_script = Python(IN[0]=string_from_object, IN[1]=reset)
# ---------- python_script.python (16 lines) ----------
#Copyright © 2016, Lingkon
# @Lingkon, lingkonn@gmail.com
###############################
x = IN[0]#string

y = '-'in x #will return True or False if contain '-' subtract

if y == True:
	ram = x[1:len(x)]#deleting first character due to it contain '-' subtract
else:
	ram = x[:len(x)]#remian first character due to it doesn't contain '-' subtract

num = int(ram)#convert to integer


OUT = str(round(num/pow(1024.00,3),2)), str(round(num/pow(1024.00,2),2))
# ----------------------------------------
code_block = CodeBlock(i=python_script) { i[0]; i[1]; }
GB = Output(code_block.out0)
MB = Output(code_block.out1)
