# Dynamo custom node Conversion_StringToBase64.dyf "StringToBase64 (BattleBIM)" (Dynamo 1.2.0.2642)
# category: BattleBIM.Conversion.base64.Create
# Convert String to base64

str = Input(str:string)
reset = Input(reset:bool = true)
python_script = Python(IN[0]=str, IN[1]=reset)
# ---------- python_script.python (11 lines) ----------
#Copyright © 2016, Lingkon
# @Lingkon, lingkonn@gmail.com
###############################
import sys
sys.path.append(r'C:\Program Files (x86)\IronPython 2.7\Lib')
import base64
st = IN[0]#main string
Bcode = base64.b64encode(st)

#Assign your output to the OUT variable.
OUT = Bcode
# ----------------------------------------
base64 = Output(python_script)
