# Dynamo custom node Core_x if y else None (BattleBIM).dyf "x if y else None (BattleBIM)" (Dynamo 1.3.0.875)
# category: BattleBIM.Core.Logic
# if test True will return x else None

test = Input(test:bool)
x = Input()
refresh = Input(refresh:bool=true)
python_script = Python(IN[0]=test, IN[1]=x, IN[2]=refresh)
# ---------- python_script.python (8 lines) ----------
#Copyright © 2017, Lingkon
# http://BattleBIM.blogspot.com
# @Lingkon, lingkonn@gmail.com
#Dated: 09/04/2017
####################################
b=IN[0]
x=IN[1]
OUT = x if b else None
# ----------------------------------------
OUT = Output(python_script)
