# Dynamo custom node Directory_Directory.Copy+.dyf "Directory.Copy+(BattleBIM)" (Dynamo 1.3.0.875)
# category: BattleBIM.Directory.Actions
# This Custom will copy file from one directory to another

copyFrom = Input(copyFrom:string)  # Directory path Example C:\Users\Lingkon\Desktop\SampleFolder
string = StringInput("*.")
searchFileType = Input(searchFileType : string = "*")  # All file = * For example just type pptx for MS powerpoint
concat = String.Concat(string, searchFileType)
copyTo = Input(copyTo:string)  # Directory path Example C:\Users\Lingkon\Desktop\SampleFolder
length = String.Length(copyTo)
code_block = CodeBlock(x1=length) { 3; x1-3; }
drive_Destination = String.Remove(str=copyTo, startIndex=code_block.out0, count=code_block.out1)
RunMe = Input(RunMe:bool = false)
python_script = Python(IN[0]=copyFrom, IN[1]=concat, IN[2]=copyTo, IN[3]=drive_Destination, IN[4]=RunMe)
# ---------- python_script.python (21 lines) ----------
#Copyright © 2016, Lingkon
# @Lingkon, lingkonn@gmail.com
###############################
targetFile=IN[0]
fileType=IN[1]
Destination=IN[2]
folder=IN[3]
import sys
sys.path.append('C:/Program Files (x86)/IronPython 2.7/Lib')
import glob, os, shutil
os.chdir(folder)
x=(Destination)
if IN[4] == True:
	if (os.path.isdir(x)==0):
		os.mkdir(x)
	files = glob.iglob(os.path.join(targetFile, fileType))
	for file in files:
		if os.path.isfile(file):
			shutil.copy2(file, Destination)
else:
	OUT = "Set RunMe to True"
# ----------------------------------------
void = Output(python_script)
