# Dynamo custom node Directory_Directory.Filter.dyf "Directory.Filter(BattleBIM)" (Dynamo 1.2.0.2761)
# category: BattleBIM.Directory.Query
# Filter Directory

directoryPath = Input(directoryPath : var[]..[])  # Single or list of directory path Example C:\Users\Lingkon\Desktop\SampleFolder Feed string
fileName = FilePath.FileName(directoryPath)
searchFor = Input()  # "searchFor = " ""; You can search for Multiple items e.g.{"sample","01"} Feed string
length = String.Length(searchFor)
firstItem = List.FirstItem(length)
uniqueItems = List.UniqueItems(fileName)
reset = Input(reset:bool = true)
python_script = Python(IN[0]=firstItem, IN[1]=searchFor, IN[2]=uniqueItems, IN[3]=reset)
# ---------- python_script.python (7 lines) ----------
#Copyright © 2016, Lingkon
# @Lingkon, lingkonn@gmail.com
###############################
if IN[0] >= 1:
	OUT = IN[1]
else:
	OUT = IN[2]
# ----------------------------------------
allIndicesOf = List.AllIndicesOf(list=fileName, item=python_script)
flatten = Flatten(allIndicesOf)
getItemAtIndex = List.GetItemAtIndex(list=directoryPath, index=flatten)
match_directoryPath = Output(getItemAtIndex)
removeItemAtIndex = List.RemoveItemAtIndex(list=directoryPath, indices=flatten)
others = Output(removeItemAtIndex)
