# Dynamo custom node Directory_DirectoryInDirectory.dyf "DirectoryInDirectory(BattleBIM)" (Dynamo 1.2.3.592)
# category: BattleBIM.Directory.Query
# This custom node will extract Directory within Directory with path
# ** For the HDD Drive type "D:\" (Drive letter:\)

directoryPath = Input(directoryPath:string)  # Example C:\Users\Lingkon\Desktop\SampleFolder For H.D.D (Hard disk drive) type e.g "H:\"
reset = Input(reset:bool = true)
python_script = Python(IN[0]=directoryPath, IN[1]=reset)
# ---------- python_script.python (13 lines) ----------
#Copyright © 2016, Lingkon
# @Lingkon, lingkonn@gmail.com
###############################
import sys
sys.path.append(r'C:\Program Files (x86)\IronPython 2.7\Lib')
import os
###############################
dataEnteringNode = IN
dic = IN[0]
dics = os.walk(dic)

###############################
OUT = [a[0] for a in dics]
# ----------------------------------------
directoriesPath = Output(python_script)
