# Dynamo custom node Directory_OS.ListDir_Name.dyf "OS.ListDir_Name(BattleBIM)" (Dynamo 1.3.0.875)
# category: BattleBIM.Directory.Query
# Get current ListDir (Name)

path = Input(path:string)  # Example C:\Users\Lingkon\Desktop\SampleFolder
reset = Input(reset:bool = true)
python_script = Python(IN[0]=path, IN[1]=reset)
# ---------- python_script.python (15 lines) ----------
#Copyright © 2016, Lingkon
# @Lingkon, lingkonn@gmail.com
###############################
a = IN[0]
import sys
sys.path.append(r'C:\Program Files (x86)\IronPython 2.7\Lib')
import os
import glob

def li(pth):
    for f in os.listdir(pth):
        if not f.startswith('.'):
            yield f

OUT =  li(a)
# ----------------------------------------
name = Output(python_script)
