# Dynamo custom node Directory_OS.ListDir_Path.dyf "OS.ListDir_Path(BattleBIM)" (Dynamo 1.3.0.875)
# category: BattleBIM.Directory.Query
# Get current ListDir (Path)

path = Input(path:string)  # Example C:\Users\Lingkon\Desktop\SampleFolder
reset = Input(reset:bool = true)
python_script = Python(IN[0]=path, IN[1]=reset)
# ---------- python_script.python (13 lines) ----------
#Copyright © 2016, Lingkon
# @Lingkon, lingkonn@gmail.com
###############################
a = IN[0]
import sys
sys.path.append(r'C:\Program Files (x86)\IronPython 2.7\Lib')
import os
import glob

def lidir(pth):
    return glob.glob(os.path.join(pth, '*'))
    
OUT =  lidir(a)
# ----------------------------------------
path_2 = Output(python_script)  # "path"
