# Dynamo custom node Directory_Seek.FileType.dyf "Seek.FileType(BattleBIM)" (Dynamo 1.3.0.875)
# category: BattleBIM.Directory.Query
# This Custom Node will return a list of unique file types which available in provided path
# **Walk

directoryPath = Input(directoryPath:string)  # sample path C:\Users\Lingkon\Desktop\Sample
reset = Input(reset:bool = true)
python_script = Python(IN[0]=directoryPath, IN[1]=reset)
# ---------- python_script.python (13 lines) ----------
#Copyright © 2016, Lingkon
# @Lingkon, lingkonn@gmail.com
###############################
import sys
sys.path.append(r'C:\Program Files (x86)\IronPython 2.7\Lib')
import os
#The inputs to this node will be stored as a list in the IN variables.
dataEnteringNode = IN
directory=IN[0]
inf = os.walk(directory)

#Assign your output to the OUT variable.
OUT = [x[0] for x in inf]
# ----------------------------------------
fromPath = DirectoryObject(python_script)  # "Directory.FromPath"
contents = Directory.Contents(fromPath)
flatten = Flatten(contents)
extension = FilePath.Extension(flatten)
uniqueItems = List.UniqueItems(extension)
FilesTypesAvailable = Output(uniqueItems)  # This Drive/Directory consist of following file types
code_block = CodeBlock { 0; -1; }
remove = String.Remove(str=uniqueItems, startIndex=code_block.out0, count=code_block.out1)
FilesTypesAvailableWithoutDot = Output(remove)  # This Drive/Directory consist of following file types
