# Dynamo custom node Display.ByGeometryRandomColor (BattleBIM).dyf (Dynamo 1.2.0.2831)
# category: BattleBIM.Display
# Display.ByGeometryRandomColor (geometry)

geometry = Input(geometry : var[]..[])  # Geometry
flatten = Flatten(geometry)
random_color_battlebim = Custom[Random Color (BattleBIM)](list=geometry)  # This custom node will generate random color
byGeometryColor = Display.Display.ByGeometryColor(flatten, random_color_battlebim)
Display = Output(byGeometryColor)
