# Dynamo custom node Dynamo_Refresh.BattleBIM.dyf "Refresh.BattleBIM" (Dynamo 1.3.0.875)
# category: BattleBIM.Dynamo
# This Custom will refresh entire Dynamo graph

list = Input()
hiccup = Input(hiccup : bool=true)
code_block = CodeBlock(list, hiccup)
# ---------- code_block.designscript (16 lines) ----------
li;
come;

[Imperative]

{
/*
#Copyright © 2017, Lingkon
# http://BattleBIM.blogspot.com
# @Lingkon, lingkonn@gmail.com
*/
 if (come ==true)
  return = li;
 else
  return = li;
};
# ----------------------------------------
data = Output(code_block.out2)
