# Dynamo custom node Dynamo_RunMe.BattleBIM.dyf "RunMe.BattleBIM" (Dynamo 1.3.0.875)
# category: BattleBIM.Dynamo
# This Custom node will return input if runMe set to True

list = Input()
runMe = Input(runMe : bool=false)
code_block = CodeBlock(list, runMe)
# ---------- code_block.designscript (16 lines) ----------
li;
hiccup;

[Imperative]

{
/*
#Copyright © 2017, Lingkon
# http://BattleBIM.blogspot.com
# @Lingkon, lingkonn@gmail.com
*/
 if (hiccup ==true)
  return = li;
 else
  return = "Set runMe to True";
};
# ----------------------------------------
data = Output(code_block.out2)
