# Dynamo custom node Dynamo_Wait.dyf "Wait(BattleBIM)" (Dynamo 1.2.0.2514)
# category: BattleBIM.Dynamo.Actions
# This Custom Node will Hold/Freeze entire graph.
# Input required by Seconds

second = Input(second:int)
reset = Input(reset:bool = true)
python_script = Python(IN[0]=second, IN[1]=reset)
# ---------- python_script.python (7 lines) ----------
#Copyright © 2016, Lingkon
# @Lingkon, lingkonn@gmail.com
###############################
s = IN[0]
import time
time.sleep(s) 
OUT = 0
# ----------------------------------------
wait = Output(python_script)
