# Dynamo custom node Excel.Hyperlink V2.dyf "Excel.Hyperlink V2 (BattleBIM)" (Dynamo 1.3.0.875)
# category: BattleBIM.Excel.Create
# This Custom Node help you to generate Hyperlink in Excel.
# * For Root directory
# ** Hyperlink will be Absolute path

ExcelFilePath = Input(ExcelFilePath:string)  # Path example C:\Users\USERNAME\Desktop\New Folder\Sample.xlsx
SheetName = Input(SheetName:string)
Row = Input(Row:int)  # except 0
column = Input(column:int)  # except 0
code_block = CodeBlock(row=Row, clm=column) { row-1; clm-1; }
DirectoryPath = Input(DirectoryPath:string)  # Directory path example C:\Users\USERNAME\Desktop\New Folder
fromPath = DirectoryObject(DirectoryPath)  # "Directory.FromPath"
string = StringInput("*.")
searchFileType = Input(searchFileType : string = "*")  # All file = * For example just type pptx for MS powerpoint
concat = String.Concat(string, searchFileType)
string_2 = StringInput("\"")
FriendlyName = Input(FriendlyName : string = " ")
# note: #Copyright © 2016, Lingkon
# # @Lingkon, lingkonn@gmail.com
code_block_2 = CodeBlock(pat=fromPath, fType=concat, c=string_2, cName=FriendlyName)
# ---------- code_block_2.designscript (5 lines) ----------
pt = Flatten(__TryGetValueFromNestedDictionaries(Directory.Contents(pat, fType), "files"));
c+pt+c;
cnt = List.Count(pt);
List.Cycle(cName,cnt);
c+FilePath.FileName(pt, false)+c;
# ----------------------------------------
code_block_3 = CodeBlock(row=Row, wholeList=code_block_2.cnt, c=string_2, a=code_block_2.out3) { b = row..wholeList+row; c+a+b+c; }
reset = Input(reset:bool = true)
python_script = Python(IN[0]=FriendlyName, IN[1]=code_block_3.out1, IN[2]=code_block_2.out4, IN[3]=reset)
# ---------- python_script.python (12 lines) ----------
#Copyright © 2016, Lingkon
# @Lingkon, lingkonn@gmail.com
###############################
string = IN[0]
x1 = IN[1]
x2 = IN[2]
###############################
if any(c.isalpha() for c in string):
	OUT = x1
else:
	OUT = x2
###############################
# ----------------------------------------
code_block_4 = CodeBlock(link=code_block_2.out1, friendlyName=python_script) { "=HYPERLINK("+link+","+friendlyName+")"; }
writeToFile = Excel.WriteToFile(filePath=ExcelFilePath, sheetName=SheetName, startRow=code_block.out0, startCol=code_block.out1, data=code_block_4)
