# Dynamo custom node Excel.Hyperlink_Files.dyf "Excel.Hyperlink_Files (BattleBIM)" (Dynamo 1.3.0.875)
# category: BattleBIM.Excel.Create
# This Custom Node help you to generate Hyperlink in Excel.
# ** Hyperlink will be Absolute path

ExcelFilePath = Input(ExcelFilePath:string)  # Path example C:\Users\USERNAME\Desktop\New Folder\Sample.xlsx
SheetName = Input(SheetName:string)
startRow = Input(startRow:int)  # Feed int Except 0
startCol = Input(startCol:int)  # Feed int Except 0
code_block = CodeBlock(row=startRow, clm=startCol) { row-1; clm-1; }
filePath = Input()  # List of file path example C:\Users\USERNAME\Desktop\New Folder\xyx.pdf File
# note: #Copyright © 2016, Lingkon
# # @Lingkon, lingkonn@gmail.com
string = StringInput("\"")
FriendlyName = Input(FriendlyName : string = " ")
code_block_2 = CodeBlock(pt=filePath, c=string, cName=FriendlyName) { pt; c+pt+c; cnt = List.Count(pt); List.Cycle(cName,cnt); c+FilePath.FileName(pt, false)+c; }
RangeStartAt = Input(RangeStartAt:int = 1)  # FriendlyName Range Start at
code_block_3 = CodeBlock(RangeStartAt=RangeStartAt, wholeList=code_block_2.cnt, c=string, a=code_block_2.out3) { b = RangeStartAt..wholeList+RangeStartAt; c+a+b+c; }
reset = Input(reset:bool = true)
python_script = Python(IN[0]=FriendlyName, IN[1]=code_block_3.out1, IN[2]=code_block_2.out4, IN[3]=reset)
# ---------- python_script.python (12 lines) ----------
#Copyright © 2016, Lingkon
# @Lingkon, lingkonn@gmail.com
###############################
string = IN[0]
x1 = IN[1]
x2 = IN[2]
###############################
if any(c.isalpha() for c in string):
	OUT = x1
else:
	OUT = x2
###############################
# ----------------------------------------
code_block_4 = CodeBlock(link=code_block_2.out1, friendlyName=python_script) { "=HYPERLINK("+link+","+friendlyName+")"; }
writeToFile = Excel.WriteToFile(filePath=ExcelFilePath, sheetName=SheetName, startRow=code_block.out0, startCol=code_block.out1, data=code_block_4)
