# Dynamo custom node File.Filter.dyf "File.Filter (BattleBIM)" (Dynamo 1.2.0.2761)
# category: BattleBIM.File.Actions
# Filter Files

file = Input(file : var[]..[])  # Example C:\Users\Lingkon\Desktop\SampleFolder\ABCD.pdf
# note: #Copyright © 2016, Lingkon
# # @Lingkon, lingkonn@gmail.com
# ###############################
extension = FilePath.Extension(file)
string = StringInput(".")
searchFor = Input()  # "searchFor = " ""; for example just type pptx for MS powerpoint
code_block = CodeBlock(a=string, b=searchFor) { a+b; }
allIndicesOf = List.AllIndicesOf(list=extension, item=code_block)
flatten = Flatten(allIndicesOf)
getItemAtIndex = List.GetItemAtIndex(list=file, index=flatten)
match_FilePath = Output(getItemAtIndex)
removeItemAtIndex = List.RemoveItemAtIndex(list=file, indices=flatten)
others = Output(removeItemAtIndex)
