# Dynamo custom node File.Open.dyf "File.Open (BattleBIM)" (Dynamo 1.2.0.2761)
# category: BattleBIM.File.Actions
# This Custom Node will open any file with default programs

filePath = Input(filePath:string = " ")  # Example C:\Users\Lingkon\Desktop\SampleFolder\ABCD.pdf
reset = Input(reset: bool= true)
python_script = Python(IN[0]=filePath, IN[1]=reset)
# ---------- python_script.python (10 lines) ----------
#Copyright © 2016, Lingkon
# @Lingkon, lingkonn@gmail.com
###############################
a=IN[0]
import sys
sys.path.append('C:/Program Files (x86)/IronPython 2.7/Lib')
import os
os.startfile(a)
###############################
OUT = "see default programs"
# ----------------------------------------
data = Output(python_script)
