# Dynamo custom node File.Size (BattleBIM).dyf (Dynamo 1.3.0.875)
# category: BattleBIM.File
# Check file size

file = Input(file : string)  # Example C:\Users\Lingkon\Desktop\SampleFolder2\ABCD.pdf
code_block = CodeBlock(li=file) { {Flatten(li)}; }
reset = Input(reset:bool = true)
python_script = Python(IN[0]=code_block, IN[1]=reset)
# ---------- python_script.python (19 lines) ----------
#Copyright © 2017, Lingkon
# http://BattleBIM.blogspot.com
# @Lingkon, lingkonn@gmail.com
####################################

import sys
sys.path.append(r'C:\Program Files (x86)\IronPython 2.7\Lib')
import os
####################################
filePaths = IN[0]
fileSize = [os.path.getsize(eachIteam) for eachIteam in filePaths]

####################################
finalFileSize = []#empty list
for eachIteam in fileSize:#converting to MB
	finalFileSize.append(float(eachIteam)/pow(1024,2))
	
####################################
OUT = finalFileSize
# ----------------------------------------
code_block_2 = CodeBlock(li=python_script) { li[0]; }
sizeInMB = Output(code_block_2)
