# Dynamo custom node File.WriteText+.dyf "File.WriteText+ (BattleBIM)" (Dynamo 1.3.0.875)
# category: BattleBIM.File.Create
# Write the text content to a specific file path
# File format “txt, doc, rtf, xls, html, xml” etc

filePath = Input(filePath:string)  # File Path to write Example C:\Users\Lingkon\Desktop\Sample.txt
data = Input()
string_from_object = FromObject(data)
reset = Input(reset:bool = true)
python_script = Python(IN[0]=filePath, IN[1]=string_from_object, IN[2]=reset)
# ---------- python_script.python (11 lines) ----------
#Copyright © 2016, Lingkon
# @Lingkon, lingkonn@gmail.com
###############################
filePath =IN[0]
data = IN[1]
import sys
sys.path.append(r'C:\Program Files (x86)\IronPython 2.7\Lib')
TextFile=open(filePath,'w')
TextFile.write("\n".join(data))
TextFile.close()
OUT = ':)'
# ----------------------------------------
void = Output(python_script)
