# Dynamo custom node Geometry_CurveToArc .dyf "CurveToArc (BattleBIM)" (Dynamo 1.3.0.875)
# category: BattleBIM.Geometry
# This Custom node will convert curve to arc

curve = Input()  # Any type of Curve. except Straight Line
Segments = Input(Segments : int = 0)  # How many arc you want? It has default value which applied with logic
code_block = CodeBlock(a=Segments) { a+2; }
code_block_2 = CodeBlock(l=curve, num=code_block) { 0..1..#Math.Ceiling(l.Length/129+1); 0..1..#num; }
code_block_3 = CodeBlock(code_block, code_block_2.out0, code_block_2.out1)
# ---------- code_block_3.designscript (10 lines) ----------
fLogic;
default;
fromUser;
[Imperative]
{
 if (fLogic>2)
  return = fromUser;
 else
  return = default;
};
# ----------------------------------------
splitByParameter = Curve.SplitByParameter(curve, code_block_3.out3)
code_block_4 = CodeBlock { 0..1..#3; }
pointAtParameter = Curve.PointAtParameter(curve=splitByParameter, param=code_block_4, lacing=CrossProduct)
transpose = List.Transpose(pointAtParameter)
code_block_5 = CodeBlock(a=transpose) { a[0]; a[1]; a[2]; }
byThreePoints = Arc.ByThreePoints(firstPoint=code_block_5.out0, secondPoint=code_block_5.out1, thirdPoint=code_block_5.out2)
Arc = Output(byThreePoints)
radius = Arc.Radius(byThreePoints)
Radius = Output(radius)  # Radius of each Arc
length = Curve.Length(byThreePoints)
ArcLength = Output(length)  # Length of each Arc
sum = Math.Sum(length)
TotalArcLength = Output(sum)  # Total Arc Length
