# Dynamo custom node Geometry_Solid.Top&BottomSurface.dyf "Solid.Top&BottomSurface (BattleBIM)" (Dynamo 1.3.0.875)
# category: BattleBIM.Geometry.Actions
# This custom node will extract Top and Bottom Surface from Solid

# note: #Copyright © 2017, Lingkon
# # http://BattleBIM.blogspot.com
# # @Lingkon, lingkonn@gmail.com
# #Dated: 09/04/2017
# ####################################

Solid = Input()
code_block = CodeBlock(Solid)
# ---------- code_block.designscript (4 lines) ----------
sld = Flatten(li1).Explode();
pt = sld.PointAtParameter(0.5, 0.5).Z;
t2 = DSCore.List.SortByKey(sld<1L>, pt<1L>);
__TryGetValueFromNestedDictionaries(t2, "sorted list");
# ----------------------------------------
lastItem = List.LastItem(code_block.out3, lacing=Longest)
topSurface = Output(lastItem)
firstItem = List.FirstItem(code_block.out3, lacing=Longest)
bottomSurface = Output(firstItem)
