# Dynamo custom node Geometry_Star.ByCircle (BattleBIM).dyf "Star.ByCircle (BattleBIM)" (Dynamo 1.3.0.875)
# category: BattleBIM.Geometry
# This custom node will create star shape from circle

# note: #Copyright © 2016, Lingkon
# # @Lingkon, lingkonn@gmail.com
# ###############################
Circle = Input()
code_block = CodeBlock { 0..1..#6; }
pointAtParameter = Curve.PointAtParameter(curve=Circle, param=code_block)
code_block_2 = CodeBlock(a=pointAtParameter) { a[1..List.Count(a)-1]; }
code_block_3 = CodeBlock { 2; }
combinations = List.Combinations(code_block_2, code_block_3)
byBestFitThroughPoints = Line.ByBestFitThroughPoints(combinations)
code_block_4 = CodeBlock { {0,3,4,7,9}; }
removeItemAtIndex = List.RemoveItemAtIndex(list=byBestFitThroughPoints, indices=code_block_4)
code_block_5 = CodeBlock(a=removeItemAtIndex) { a[0]; }
combinations_2 = List.Combinations(removeItemAtIndex, code_block_3)
code_block_6 = CodeBlock { 1; }
getItemAtIndex = List.GetItemAtIndex(list=combinations_2, index=code_block_6, lacing=Longest)
removeItemAtIndex_2 = List.RemoveItemAtIndex(list=combinations_2, indices=code_block_6)
intersect = Geometry.Intersect(geometry=getItemAtIndex, other=removeItemAtIndex_2)
flatten = Flatten(intersect)
code_block_7 = CodeBlock { Autodesk.Point.Origin(); }
type = Object.Type(code_block_7)
removeIfNot = RemoveIfNot(flatten, type)
code_block_8 = CodeBlock(li=removeIfNot) { ind = {1,3,5,6,9,11}; li[ind]; }
code_block_9 = CodeBlock(li=code_block_8.out1) { ind = {1,0}; li[ind]; }
splitByPoints = Curve.SplitByPoints(curve=code_block_5, points=code_block_9.out1)
code_block_10 = CodeBlock(a=splitByPoints) { List.FirstItem(a); List.LastItem(a); }
code_block_11 = CodeBlock(a=removeItemAtIndex) { a[1]; }
code_block_12 = CodeBlock(li=code_block_8.out1) { ind = {4,2}; li[ind]; }
splitByPoints_2 = Curve.SplitByPoints(curve=code_block_11, points=code_block_12.out1)
code_block_13 = CodeBlock(a=splitByPoints_2) { List.FirstItem(a); List.LastItem(a); }
code_block_14 = CodeBlock(a=removeItemAtIndex) { a[3]; }
code_block_15 = CodeBlock(li=code_block_8.out1) { ind = {1,4}; li[ind]; }
splitByPoints_3 = Curve.SplitByPoints(curve=code_block_14, points=code_block_15.out1)
code_block_16 = CodeBlock(a=splitByPoints_3) { List.FirstItem(a); List.LastItem(a); }
code_block_17 = CodeBlock(a=removeItemAtIndex) { a[4]; }
code_block_18 = CodeBlock(li=code_block_8.out1) { ind = {2,5}; li[ind]; }
splitByPoints_4 = Curve.SplitByPoints(curve=code_block_17, points=code_block_18.out1)
code_block_19 = CodeBlock(a=splitByPoints_4) { List.FirstItem(a); List.LastItem(a); }
code_block_20 = CodeBlock(a=removeItemAtIndex) { a[2]; }
code_block_21 = CodeBlock(li=code_block_8.out1) { ind = {0,5}; li[ind]; }
splitByPoints_5 = Curve.SplitByPoints(curve=code_block_20, points=code_block_21.out1)
code_block_22 = CodeBlock(a=splitByPoints_5) { List.FirstItem(a); List.LastItem(a); }
create = List.Create(code_block_10.out0, code_block_13.out0, code_block_16.out1, code_block_16.out0, code_block_19.out1, code_block_13.out1, code_block_22.out1, code_block_19.out0, code_block_10.out1, code_block_22.out0)
byJoinedCurves = PolyCurve.ByJoinedCurves(create)
Star = Output(byJoinedCurves)
