# Dynamo custom node HTML Table Reader.dyf "HTML Table Reader (BattleBIM)" (Dynamo 1.3.0.875)
# category: BattleBIM.HTML
# This Custom node will read table from HTML

Example_table_class = Input(/*Example <table class="details" border="0" cellpadding="5" cellspacing="2" width="95%"> <tr valign="top"> <th>Tests</th> <th>Failures</th> <th>Success Rate</th> <th>Average Time</th> <th>Min Time</th> <th>Max Time</th> </tr> <tr valign="top" class="Failure"> <td>103</td> <td>24</td> <td>76.70%</td> <td>71 ms</td> <td>0 ms</td> <td>829 ms</td> </tr> <tr valign="top" class="whatever"> <td>A</td> <td>B</td> <td>C</td> <td>D</td> <td>E</td> <td>F</td> </tr> </table> */ str)
python_script = Python(IN[0]=Example_table_class)
# ---------- python_script.python (29 lines) ----------
#Copyright © 2017, Lingkon
# http://BattleBIM.blogspot.com
# @Lingkon, lingkonn@gmail.com
# sourceCode: googleSearch :) 
####################################

import clr
clr.AddReference('ProtoGeometry')
from Autodesk.DesignScript.Geometry import *
#The inputs to this node will be stored as a list in the IN variables.
import sys
sys.path.append(r'C:\Program Files (x86)\IronPython 2.7\Lib')
from xml.etree.ElementTree import fromstring

HTML = IN[0]



tree = fromstring(HTML)
rows = tree.findall("tr")
headrow = rows[0]
datarows = rows[1:]

datasets = []

for num, h in enumerate(headrow):
    data = ", ".join([row[num].text for row in datarows])
    datasets.append("{0:<16}: {1}".format(h.text, data))
OUT = datasets
# ----------------------------------------
str = Output(python_script)
