# Dynamo custom node HTML Tag Extractor.dyf "HTML Tag Extractor (BattleBIM)" (Dynamo 1.3.0.875)
# category: BattleBIM.HTML
# This Custom node will extract text from in-between Tag
# Example:
# <p>Paragraph one</p>
# <p>Paragraph two</p>
# <t>Paragraph threeea</t>
# <p>Paragraph three.*</p>
# <t>Paragraph three</t>
# Tag = p

Feed_String_p_Paragraph_one_p_p_Paragrap = Input(/*Feed String <p>Paragraph one</p> <p>Paragraph two</p> <t>Paragraph threeea</t> <p>Paragraph three.*</p> <t>Paragraph three</t>*/ str)
TagName = Input(TagName:string)
reset = Input(reset:bool = true)
python_script = Python(IN[0]=Feed_String_p_Paragraph_one_p_p_Paragrap, IN[1]=TagName, IN[2]=reset)
# ---------- python_script.python (13 lines) ----------
#Copyright © 2017, Lingkon
# http://BattleBIM.blogspot.com
# @Lingkon, lingkonn@gmail.com
#Dated: 09/06/2017
####################################

import re

html = IN[0] #HTML file

tag = IN[1] #Tag Name

OUT = re.findall(r'<'+tag+'>(.*?)</'+tag+'>', html)
# ----------------------------------------
str = Output(python_script)
