# Dynamo custom node HTML.Clean.dyf "HTML.Clean (BattleBIM)" (Dynamo 1.2.0.2831)
# category: BattleBIM.HTML
# This custom node will remove all Tags and witll return only Text in-between Tag

htmlFile = Input()  # Example D:\...\Pyhton\HTML read\Mechanical to Sprinkler.html
readText = File.ReadText(htmlFile)
python_script = Python(IN[0]=readText)
# ---------- python_script.python (8 lines) ----------
import re

html = IN[0] #HTML file


x = re.sub('<[^>]*>', '', html)

OUT = x
# ----------------------------------------
str = Output(python_script)
