# Dynamo custom node HTML_Reports HTML to Element ID V2.dyf "Reports HTML to Element ID (BattleBIM) V2" (Dynamo 1.2.0.2831)
# category: BattleBIM.HTML
# This Custom node will extract Element ID from HTML file (Navisworks report)

htmlFilePath = Input()  # Example D:\...\Pyhton\HTML read\Mechanical to Sprinkler.html
python_script = Python(IN[0]=htmlFilePath)
# ---------- python_script.python (12 lines) ----------
import sys
sys.path.append(r'C:\Program Files (x86)\IronPython 2.7\Lib')

a = IN[0]

import re
html_text = open(a).read()

text_filtered = re.sub(r'<(.*?)>', '', html_text)


OUT = text_filtered
# ----------------------------------------
string = StringInput("\n")
split = String.Split(python_script, string)
trimWhitespace = String.TrimWhitespace(split)
string_2 = StringInput("Element ID:")
allIndicesOf = List.AllIndicesOf(list=trimWhitespace, item=string_2)
code_block = CodeBlock(a=allIndicesOf) { a+1; }
getItemAtIndex = List.GetItemAtIndex(list=trimWhitespace, index=code_block)
trimWhitespace_2 = String.TrimWhitespace(getItemAtIndex)
toNumber = String.ToNumber(trimWhitespace_2)
ID_s = Output(toNumber)  # "ID's"
