# Dynamo custom node HTML_Reports HTML to Element ID.dyf "Reports HTML to Element ID" (Dynamo 1.2.0.2831)
# category: BattleBIM.HTML
# This Custom node will extract Element ID from HTML file (Navisworks report)

htmlFilePath = Input()  # Example D:\...\Pyhton\HTML read\Mechanical to Sprinkler.html
clean = Custom[HTML.Clean](htmlFile=htmlFilePath)  # This custom node will remove all Tags and witll return only Text in-between Tag
str_extract_integer = Custom[Str.Extract Integer](IN=clean)  # This custom node will extract integer from string. Example: This is 100 dollar result will be 100 ** Make sure "This is 100 dollar" NOT "This is100dollar"
flatten = Flatten(str_extract_integer)
string_from_object = FromObject(flatten)
length = String.Length(string_from_object)
length_of_element_id = CodeBlock { 6; }
eq = length == length_of_element_id
filterByBoolMask = List.FilterByBoolMask(list=flatten, mask=eq)
watch = Watch(filterByBoolMask.in)
ID_s = Output(watch)  # "ID's"
