# Dynamo custom node List.DuplicateItems.dyf "List.DuplicateItems (BattleBIM)" (Dynamo 1.2.0.2761)
# category: BattleBIM.List.Actions
# This Custom node will return list of Duplicate items and their Index number

list = Input(list : var[]..[])  # Feed anything (string or int or float)
# note: Copyright © 2016, Lingkon
# @Lingkon, lingkonn@gmail.com
flatten = Flatten(list)

# group: Finding Duplicate Items From a List (I Trust)
uniqueItems = List.UniqueItems(flatten)
allIndicesOf = List.AllIndicesOf(list=flatten, item=uniqueItems)
code_block = CodeBlock { 1; }
count = Count(allIndicesOf, lacing=Longest)
eq = code_block == count
filterByBoolMask = List.FilterByBoolMask(list=allIndicesOf, mask=eq)
watch = Watch(filterByBoolMask.out)
count_2 = Count(watch, lacing=Longest)
code_block_2 = CodeBlock(x=count_2) { 1..x-1; }
getItemAtIndex = List.GetItemAtIndex(list=watch, index=code_block_2, lacing=Longest)
flatten_2 = Flatten(getItemAtIndex)  # "Flatten (IndexNumberOfDuplicateItems)"
list_getitematindex = List.GetItemAtIndex(list=flatten, index=flatten_2)  # "List.GetItemAtIndex (DuplicateItems)"

duplicateItems = Output(list_getitematindex)  # will return duplicate Items from the list
indexNumber = Output(flatten_2)  # Index number of Duplicate items
