# Dynamo custom node List.Filter.dyf "List.Filter (BattleBIM)" (Dynamo 1.3.0.875)
# category: BattleBIM.List.Query
# Filter as you type

items = Input()  # String
code_block = CodeBlock(items=items) { Flatten(List.AddItemToFront(items,List.Empty)); }
string_from_object = FromObject()  # unwired: arg0
searchFor = Input()  # String
string_from_object_2 = FromObject(searchFor)
reset = Input(reset:bool = true)
contains = String.Contains(searchFor=string_from_object_2, ignoreCase=reset)  # unwired: str
compose = ComposeFunctions(string_from_object, contains)  # "Function.Compose"
list_filter_battlebim = Filter(code_block, compose)
Match = Output(list_filter_battlebim.out0)
Others = Output(list_filter_battlebim.out1)
