# Dynamo custom node List.Filter_ordered.dyf "List.Filter_ordered (BattleBIM)" (Dynamo 1.2.0.2831)
# category: BattleBIM.List.Query
# Select multiple elements/str from the list/nested list

list = Input(list : var[]..[])  # Revit elements or any item List Levels must be @L3 (i.e. @L3@L2@L1)
flatten = Flatten(list)
string_from_object = FromObject(list)
flatten_2 = Flatten(string_from_object)
searchFor = Input()  # String Search string have to be exact match
string_from_object_2 = FromObject(searchFor)
flatten_3 = Flatten(string_from_object_2)
allIndicesOf = List.AllIndicesOf(list=flatten_2, item=flatten_3)
flatten_4 = Flatten(allIndicesOf)
getItemAtIndex = List.GetItemAtIndex(list=flatten, index=flatten_4)
Match = Output(getItemAtIndex)
removeItemAtIndex = List.RemoveItemAtIndex(list=flatten, indices=flatten_4)
Others = Output(removeItemAtIndex)
allIndicesOf_2 = List.AllIndicesOf(item=removeItemAtIndex, lacing=Longest)  # unwired: list
map = List.Map(list=list, f_x=allIndicesOf_2)
flatten_5 = Flatten(map, lacing=Longest)
uniqueItems = List.UniqueItems(flatten_5, lacing=Longest)
count = List.Count(uniqueItems, lacing=Longest)
chop = List.Chop(list=removeItemAtIndex, lengths=count)
listTree = Output(chop)
