# Dynamo custom node List.GetItemAtStringMatch (BattleBIM).dyf (Dynamo 1.3.0.875)
# category: BattleBIM.List.Actions
# This custom node will extract whole list if the String Match

# note: #Copyright © 2016, Lingkon
# # @Lingkon, lingkonn@gmail.com

code_block = CodeBlock { "######"; 1; }
list = Input(list : var []..[])  # Feed list of list (can be mix with str, int & num) list levels should be @L3
# note: #Copyright © 2016, Lingkon
# # @Lingkon, lingkonn@gmail.com
string_from_object = FromObject(list)
join = String.Join(code_block.out0, string_from_object)
flatten = Flatten(join)
searchFor = Input()
string_from_object_2 = FromObject(searchFor)
code_block_2 = CodeBlock { true; }
contains = String.Contains(str=flatten, searchFor=string_from_object_2, ignoreCase=code_block_2)
filterByBoolMask = List.FilterByBoolMask(list=flatten, mask=contains)
split = String.Split(filterByBoolMask.in, code_block.out0)
item = Output(split)  # will return list of String
boolean = BoolSelector(true)
allIndicesOf = List.AllIndicesOf(list=contains, item=boolean)
indexNumber = Output(allIndicesOf)
boolean_2 = Output(contains)  # "boolean"
