# Dynamo custom node List.Integer.Even and Odd (BattleBIM).dyf "Integer.Even and Odd (BattleBIM)" (Dynamo 1.3.0.875)
# category: BattleBIM.List.Integer.Query
# This Custom node will distinguish Even and Odd number

# note: #Copyright © 2015, Lingkon
# # @Lingkon, lingkonn@gmail.com
# ###############################
seq = Input()  # Feed list of integrer only
code_block = CodeBlock(num=seq) { num%2==0; }
filterByBoolMask = List.FilterByBoolMask(list=seq, mask=code_block)
Even = Output(filterByBoolMask.in)  # i.e 0,2,4,6
Odd = Output(filterByBoolMask.out)  # i.e 1,3,5,7
Boolean = Output(code_block)  # True and False
