# Dynamo custom node List.LastItem.dyf "List.LastItem (BattleBIM)" (Dynamo 1.3.0.875)
# category: BattleBIM.List.Actions
# Extract last item from each list

list = Input(list : var[]..[])  # Feed anything (string or int or float)
# note: #Copyright © 2016, Lingkon
# # @Lingkon, lingkonn@gmail.com
lastItem = List.LastItem(list, lacing=Longest)
last = Output(lastItem)
