# Dynamo custom node List.Reverse.dyf "List.Reverse (BattleBIM)" (Dynamo 1.3.0.875)
# category: BattleBIM.List.Create
# Creates a new list containing the items of the given list but in reverse order.
# Input MUST be List of String .

list = Input()
string_from_object = FromObject(list)
reset = Input(reset:bool = true)
python_script = Python(IN[0]=string_from_object, IN[1]=reset)
# ---------- python_script.python (7 lines) ----------
#Copyright © 2016, Lingkon
# @Lingkon, lingkonn@gmail.com
###############################

txt = IN[0]

OUT = [txt[::-1] for txt in txt]
# ----------------------------------------
list_2 = Output(python_script)  # "list"
