# Dynamo custom node List.TakeEvenAndOdd.dyf "List.TakeEvenAndOdd (BattleBIM)" (Dynamo 1.2.0.2831)
# category: BattleBIM.List.Actions
# This custom node will separate Even and Odd item

list = Input(list : var[]..[])  # Any list
code_block = CodeBlock { 2; 0; }
dropEveryNthItem = List.DropEveryNthItem(list=list, n=code_block.out0, offset=code_block.out1)
EvenItem = Output(dropEveryNthItem)  # If list consist of [0..9] It will return {0,2,4}
takeEveryNthItem = List.TakeEveryNthItem(list, code_block.out0, code_block.out1)
OddItem = Output(takeEveryNthItem)  # If list consist of [0..9] It will return {1,3,9}
