# Dynamo custom node OS.ComputerName(Py).dyf "OS.ComputerName(Py) (BattleBIM)" (Dynamo 1.2.0.2642)
# category: BattleBIM.OS.Path.Query
# This Custom node will retrieves your Computer Name

reset = Input(reset:bool = true)
python_script = Python(IN[0]=reset)
# ---------- python_script.python (6 lines) ----------
#Copyright © 2016, Lingkon
# @Lingkon, lingkonn@gmail.com
###############################

import socket
OUT = socket.gethostname()
# ----------------------------------------
ComputerName = Output(python_script)
