# Dynamo custom node OS.IPAddress.dyf "OS.IPAddress (BattleBIM)" (Dynamo 1.2.0.2642)
# category: BattleBIM.OS.Network.Query
# Get your IP Address

reset = Input(reset:bool = true)
python_script = Python(IN[0]=reset)
# ---------- python_script.python (6 lines) ----------
#Copyright © 2016, Lingkon
# @Lingkon, lingkonn@gmail.com
###############################

import socket
OUT = socket.gethostbyname(socket.gethostname())
# ----------------------------------------
code_block = CodeBlock(b=python_script) { "Your local IP address is\n"+List.LastItem(b); }
IP_Address = Output(code_block)
