# Dynamo custom node OS.TimeConvert.dyf "OS.TimeConvert (BattleBIM)" (Dynamo 1.3.0.875)
# category: BattleBIM.OS.Time.Actions
# Convert yyyymmddHHMMSS.mmmmmmsUUU to YYYY-MM-DD  HH:MM:SS

dateAndTime = Input()  # Sample 20160927091933 Please use 24 hour time
string_from_object = FromObject(dateAndTime)
reset = Input(reset:bool = true)
python_script = Python(IN[0]=string_from_object, IN[1]=reset)
# ---------- python_script.python (9 lines) ----------
#Copyright © 2016, Lingkon
# @Lingkon, lingkonn@gmail.com
###############################
import sys
sys.path.append(r'C:\Program Files (x86)\IronPython 2.7\Lib')
import datetime
kill=datetime.datetime.strptime(IN[0],'%Y%m%d%H%M%S')
a = str(kill)
OUT = a
# ----------------------------------------
OUT = Output(python_script)  # YYYY-MM-DD  HH:MM:SS
