# Dynamo custom node OS_CopyToClipboard(Array).dyf "CopyToClipboard (BattleBIM)(Array)" (Dynamo 1.2.1.3083)
# category: BattleBIM.OS.Copy
# This Custom node will convert list to array then send copy to clipboard

str = Input()
string_from_array = FromArray(str)
python_script = Python(IN[0]=string_from_array)
# ---------- python_script.python (21 lines) ----------
import clr
clr.AddReference('ProtoGeometry')
from Autodesk.DesignScript.Geometry import *
#The inputs to this node will be stored as a list in the IN variables.
import sys
sys.path.append(r'C:\Program Files (x86)\IronPython 2.7\Lib')
import subprocess
dataEnteringNode = IN

def copy2clip(txt):
	cmd='echo '+txt.strip()+'|clip'
	return subprocess.check_call(cmd, shell=True)
	
clipboard = copy2clip(IN[0])

if clipboard==0:
	OUT = 'Press Ctrl + V\nTo see result'
else:
	OUT = 'Jam'
#Assign your output to the OUT variable.
#OUT = clipboard
# ----------------------------------------
array = Output(python_script)
