# Dynamo custom node OS_jamShitStr To Normal String(List).dyf "jamShitStr To Normal String (BattleBIM)(List)" (Dynamo 1.2.1.3083)
# category: BattleBIM.OS.Copy
# This custom node will clean jamShitStr To Normal String (BattleBIM)
# ** Applicable for list

jamShitStr = Input(jamShitStr: string)
string = StringInput("########################")
split = String.Split(jamShitStr, string)
code_block = CodeBlock(a=split) { a[0..DSCore.List.Count(a)-2]; }
trimWhitespace = String.TrimWhitespace(code_block)
code_block_2 = CodeBlock { 0; 1; }
remove = String.Remove(str=trimWhitespace, startIndex=code_block_2.out0, count=code_block_2.out1)
code_block_3 = CodeBlock(a=trimWhitespace) { a!=""; }
filterByBoolMask = List.FilterByBoolMask(list=remove, mask=code_block_3)
Normal_String = Output(filterByBoolMask.in)
