# Dynamo custom node OS_jamShitStr To Normal String.dyf "jamShitStr To Normal String (BattleBIM)" (Dynamo 1.2.1.3083)
# category: BattleBIM.OS.Copy
# This custom node will clean jamShitStr To Normal String
# ** Applicable for single line string

jamShitStr = Input(jamShitStr: string)
string = StringInput("########################")
split = String.Split(jamShitStr, string)
trimWhitespace = String.TrimWhitespace(split)
code_block = CodeBlock(a=trimWhitespace) { a!=""; }
filterByBoolMask = List.FilterByBoolMask(list=trimWhitespace, mask=code_block)
Normal_String = Output(filterByBoolMask.in)
