# Dynamo custom node Revit_Document.BuiltInCategories (BattleBIM).dyf "Document.BuiltInCategories (BattleBIM)" (Dynamo 1.2.1.3083)
# category: BattleBIM.Revit.Element.Category
# List all the available BuiltInCategories
# *Base node from [Clockwork.Revit.Document.Query]

reset = Input(reset:bool=true)

# group: Document.BuiltInCategories
python_script = Python(IN[0]=reset)
# ---------- python_script.python (15 lines) ----------
import clr
import System
clr.AddReference('RevitAPI')
clr.AddReference('RevitAPIUI')
from Autodesk.Revit.DB import *
import Autodesk

bics = System.Enum.GetValues(BuiltInCategory)
cdata = list()
for bic in bics:
	try:
		cdata.append((bic,ElementId(bic)))
	except:
		pass
OUT = cdata
# ----------------------------------------
transpose = List.Transpose(python_script)
code_block = CodeBlock(seq=transpose) { seq[0]; seq[1]; }
watch = Watch(code_block.out0)
string_from_object = FromObject(watch)
sort = Custom[String.Sort](String=string_from_object, reset=reset)  # String (Text) Sort
byName = Category.ByName(sort)
boolean = BoolSelector(false)
clean = List.Clean(list=byName, preserveIndices=boolean)

BuiltInCategories = Output(clean)
