# Dynamo custom node Revit_Element.FilterTree(BattleBIM).dyf "Element.FilterTree(BattleBIM)" (Dynamo 1.2.0.2831)
# category: BattleBIM.Revit.Selection.Query
# Filter multiple elements from nested list as you type

ListOfElement = Input()  # Elements var[]..[]
string_from_object = FromObject(ListOfElement)
# note: #Copyright © 2016, Lingkon
# # @Lingkon, lingkonn@gmail.com
# ###############################
flatten = Flatten(string_from_object)
searchFor = Input()  # String
flatten_2 = Flatten(searchFor)
ignoreCase = Input(ignoreCase:bool=true)  # Set True for partial match and False for exact match
contains = String.Contains(str=flatten, searchFor=flatten_2, ignoreCase=ignoreCase, lacing=CrossProduct)
flatten_3 = Flatten()  # unwired: arg0
map = List.Map(list=contains, f_x=flatten_3)
formula = Formula("x=1")  # unwired: arg0
trueForAny = TrueForAny(arg1=formula)  # unwired: arg0
map_2 = List.Map(list=map, f_x=trueForAny)
count = List.Count(ListOfElement, lacing=Longest)
chop = List.Chop(list=map_2, lengths=count)
filterByBoolMask = List.FilterByBoolMask(list=ListOfElement, mask=chop)
boolean = BoolSelector(false)
clean = List.Clean(list=filterByBoolMask.in, preserveIndices=boolean)
flatten_4 = Flatten(clean)
watch = Watch(flatten_4)
Match = Output(watch)
watch_2 = Watch(filterByBoolMask.out)
Others = Output(watch_2)
