# Dynamo custom node Revit_Elements in Views From Link Doc (BattleBIM).dyf "Elements in Views From Link Doc (BattleBIM)" (Dynamo 1.3.0.875)
# category: BattleBIM.Revit.Links
# This custom node will retrive elements from views of link document

LinkDoc = Input()  # Autodesk.Revit.DB.Document Use List.FirstItem
code_block = CodeBlock(li=LinkDoc) { Flatten({li}); }
views = Input()
python_script = Python(IN[0]=code_block, IN[1]=views)
# ---------- python_script.python (26 lines) ----------
#Modified for BattleBIM by Lingkon
#Copyright  © 2017, Lingkon
#@Lingkon, lingkonn@gmail.com
#Source Code by Marc Tavenier @marctavenier
import clr
clr.AddReference('RevitAPI')
from Autodesk.Revit.DB import *

clr.AddReference('RevitServices')
import RevitServices
from RevitServices.Persistence import DocumentManager

#The inputs to this node will be stored as a list in the IN variable.
dataEnteringNode = IN

views = UnwrapElement(IN[0])

elementlist = []
doc = IN[1]#DocumentManager.Instance.CurrentDBDocument

for view in views:
	collector = FilteredElementCollector(doc, view.Id)
	elementlist.append(collector.ToElements())

#Assign your output to the OUT variable
OUT = elementlist
# ----------------------------------------
OUT = Output(python_script)
reset = Input(reset:bool=true)
