# Dynamo custom node Revit_Get Active View (BattleBIM).dyf "Get Active View (BattleBIM)" (Dynamo 1.2.1.3083)
# category: BattleBIM.Revit.Selection
# Get Active View

refresh = Input(refresh:bool=true)
current = Document.Current()
if_ = If(test=refresh, true=current, false=current)
activeView = Document.ActiveView(if_)
ActiveView = Output(activeView)
