# Dynamo custom node Revit_Get All Views(BattleBIM).dyf "Get All Views(BattleBIM)" (Dynamo 1.3.3.4111)
# category: BattleBIM.Revit.Selection
# This node will query all views in the model and return them based on category

# note: #Copyright © 2016, Lingkon
# # @Lingkon, lingkonn@gmail.com
# ###############################
categories = Categories("Views")
all_elements_of_category = ElementsOfCategory(categories)
watch = Watch(all_elements_of_category)
boolean = BoolSelector(false)
clean = List.Clean(list=watch, preserveIndices=boolean)
string = StringInput("Type")
getParameterValueByName = Element.GetParameterValueByName(element=clean, parameterName=string)
code_block = CodeBlock { ""; }
containsItem = List.ContainsItem(list=getParameterValueByName, item=code_block, lacing=Longest)
filterByBoolMask = List.FilterByBoolMask(list=getParameterValueByName, mask=containsItem)
watch_2 = Watch(filterByBoolMask.out)
uniqueItems = List.UniqueItems(watch_2)
allIndicesOf = List.AllIndicesOf(list=getParameterValueByName, item=uniqueItems)
getItemAtIndex = List.GetItemAtIndex(list=clean, index=allIndicesOf)
string_2 = StringInput("View Name")
getParameterValueByName_2 = Element.GetParameterValueByName(element=getItemAtIndex, parameterName=string_2)
reset = Input(reset:bool = true)
string_sort_battlebim = Custom[String.Sort](String=getParameterValueByName_2, reset=reset, lacing=Longest)  # String (Text) Sort
allIndicesOf_2 = List.AllIndicesOf(list=getParameterValueByName_2, item=string_sort_battlebim, lacing=Longest)
flatten = Flatten(allIndicesOf_2, lacing=Longest)
reorder = Reorder(getItemAtIndex, flatten)
views = Output(reorder)
reorder_2 = Reorder(getParameterValueByName_2, flatten)
viewName = Output(reorder_2)
UniqueViewName = Output(uniqueItems)
