# Dynamo custom node Revit_Grid.Dimension(BattleBIM).dyf "Grid.Dimension(BattleBIM)" (Dynamo 1.3.0.875)
# category: BattleBIM.Revit.Dimension
# This Custom node will place overall and multi segment dimensions according to grids

reset = Input(reset:bool=true)
get_revit_activeview = Custom[Get Revit ActiveView](reset=reset)  # Active View
selectGrids = Input()
code_block = CodeBlock(eml=selectGrids) { eml.Name; }
python_script = Python(IN[0]=code_block, IN[1]=reset)
# ---------- python_script.python (11 lines) ----------
#Copyright © 2016, Lingkon
# @Lingkon, lingkonn@gmail.com
###############################

x=IN[0]
import re
def sort(x): 
    convertText = lambda text: int(text) if text.isdigit() else text.lower() 
    Textkey = lambda key: [ convertText(c) for c in re.split('([0-9]+)', key) ] 
    return sorted(x, key = Textkey)
OUT = sort(x)
# ----------------------------------------
code_block_2 = CodeBlock(l2=selectGrids, li=code_block, val=python_script) { DSCore.List.GetItemAtIndex(l2,Flatten(DSCore.List.AllIndicesOf(li,val))); }
code_block_3 = CodeBlock(l=code_block_2) { {DSCore.List.FirstItem(l),DSCore.List.LastItem(l)}; }
create = List.Create(code_block_3, selectGrids)
OverallLocation = Input()
curves = Element.Curves(OverallLocation)
multisegmentLocation = Input()
curves_2 = Element.Curves(multisegmentLocation)
create_2 = List.Create(curves, curves_2)
byElements = Dimension.ByElements(get_revit_activeview, create, create_2, lacing=Longest)
Dimension = Output(byElements)
