# Dynamo custom node Revit_Model Categories (BattleBIM).dyf "Model Categories (BattleBIM)" (Dynamo 1.2.1.3083)
# category: BattleBIM.Revit.Element.Category
# List of Model Categories
# According to "Visibility/Graphic Overrides for Floor Plan"

string = StringInput("""OST_DuctTerminal
OST_Areas
OST_CableTrayFitting
OST_CableTray
OST_Casework
OST_Ceilings
OST_Columns
OST_CommunicationDevices
OST_ConduitFitting
OST_Conduit
OST_CurtainWallPanels
OST_CurtaSystem
OST_CurtainWallMullions
OST_DataDevices
OST_DetailComponents
OST_FilledRegion
OST_MaskingRegion
OST_Doors
OST_DuctAccessory
OST_DuctFitting
OST_DuctInsulations
OST_DuctLinings
OST_PlaceHolderDucts
OST_DuctSystem
OST_DuctCurves
OST_ElectricalEquipment
OST_ElectricalFixtures
OST_Entourage
OST_FireAlarmDevices
OST_FlexDuctCurves
OST_FlexPipeCurves
OST_Floors
OST_Furniture
OST_FurnitureSystems
OST_GenericModel
OST_Grids
OST_Gutter
OST_HVAC_Zones
OST_Levels
OST_LightingDevices
OST_LightingFixtures
OST_Lines
OST_Mass
OST_MechanicalEquipment
OST_FabricationContainment
OST_FabricationDuctwork
OST_FabricationHangers
OST_FabricationPipework
OST_NurseCallDevices
OST_BuildingPad
OST_Parking
OST_Parts
OST_PipeAccessory
OST_PipeFitting
OST_PlaceHolderPipes
OST_PipeCurves
OST_Planting
OST_PlumbingFixtures
OST_StairsRailing
OST_RailingSupport
OST_RailingTermination
OST_RailingTopRail
OST_StairsRailingBaluster
OST_RailingHandRail
OST_Ramps
OST_RasterImages
OST_Roads
OST_Roofs
OST_RoofSoffit
OST_Fascia
OST_SecurityDevices
OST_ShaftOpening
OST_Site
OST_SpecialityEquipment
OST_Sprinklers
OST_Stairs
OST_StairsRuns
OST_StairsSupports
OST_StairsLandings
OST_AreaRein
OST_StructuralFramingSystem
OST_StructuralColumns
OST_StructConnections
OST_FabricAreas
OST_FabricReinforcement
OST_StructuralFoundation
OST_StructuralFraming
OST_PathRein
OST_Rebar
OST_Coupler
OST_StructuralStiffener
OST_StructuralTruss
OST_TelephoneDevices
OST_Topography
OST_Walls
OST_Windows
OST_Wire
""")
code_block = CodeBlock { "\n"; }
split = String.Split(string, code_block)
byName = Category.ByName(split)
watch = Watch(byName)
boolean = BoolSelector(false)
clean = List.Clean(list=watch, preserveIndices=boolean)
ModelCategories = Output(clean)  # List of Model Categories According to "Visibility/Graphic Overrides for Floor Plan"
# note: #Copyright  © 2017, Lingkon
# #@Lingkon, lingkonn@gmail.com
# #BattleBIM
# Dated: 09/04/2017
reset = Input(reset:bool=true)
