# Dynamo custom node Revit_Print Settings.dyf "Print Settings" (Dynamo 1.3.0.875)
# category: BattleBIM.Revit.Modify.Print.Query
# This custom node will retrieve Print Settings from Document

document = Input()  # The document you are enquiring from. Autodesk.Revit.DB.Document Use List.FirstItem
python_script = Python(IN[0]=document)
# ---------- python_script.python (26 lines) ----------
#Copyright(c) 2015, Konrad Sobon
# @arch_laboratory, http://archi-lab.net
#Modified by@Lingkon, lingkonn@gmail.com for BattleBIM

import clr
clr.AddReference('ProtoGeometry')
from Autodesk.DesignScript.Geometry import *

# Import DocumentManager and TransactionManager
clr.AddReference("RevitServices")
import RevitServices
from RevitServices.Persistence import DocumentManager
from RevitServices.Transactions import TransactionManager

doc = IN[0]

# Import RevitAPI
clr.AddReference("RevitAPI")
import Autodesk
from Autodesk.Revit.DB import *
import System

ps = FilteredElementCollector(doc).OfClass(PrintSetting)

#Assign your output to the OUT variable
OUT = [i.Name for i in ps],[i.Id for i in ps]
# ----------------------------------------
code_block = CodeBlock(o=python_script) { o[0]; o[1]; }
name = Output(code_block.out0)  # Name of Print Settings from specified Document
id = Output(code_block.out1)  # Id of Print Settings from specified Document
