# Dynamo custom node Revit_Revit Backup File Remover (BattleBIM).dyf "Revit Backup File Remover (BattleBIM)" (Dynamo 1.3.0.875)
# category: BattleBIM.Revit.BackupFile
# This custom node will remove Revit Backup File
# ** This custom node will removed Revit Backup File (rvt). If the filename ended with “0001 – 0999” after “.” Which means last 4 digits. If the filename doesn’t contain 4 digits at the end, this custom node with NOT remove.
# i.e.  “Lingkon.0001.rvt” between “Lingkon.0999.rvt”

directoryPath = Input(directoryPath:string)  # Example C:\Users\Lingkon\Desktop\SampleFolder
# note: #Copyright © 2017, Lingkon
# # http://BattleBIM.blogspot.com
# # @Lingkon, lingkonn@gmail.com
# #Dated: 09/04/2017
# ####################################
fromPath = DirectoryObject(directoryPath)  # "Directory.FromPath"
string = StringInput("*.rvt")
contents = Directory.Contents(fromPath, string)
flatten = Flatten(contents)
boolean = BoolSelector(false)
fileName = FilePath.FileName(flatten, boolean)
code_block = CodeBlock { "."; }
lastIndexOf = String.LastIndexOf(fileName, code_block)
code_block_2 = CodeBlock(a=lastIndexOf) { 0; a+1; }
remove = String.Remove(str=fileName, startIndex=code_block_2.out0, count=code_block_2.out1)
length = String.Length(remove)
code_block_3 = CodeBlock(li=length) { li==4; }
filterByBoolMask = List.FilterByBoolMask(list=flatten, mask=code_block_3)
filterByBoolMask_2 = List.FilterByBoolMask(list=remove, mask=code_block_3)
toNumber = String.ToNumber(filterByBoolMask_2.in)
isNull = Object.IsNull(toNumber)
filterByBoolMask_3 = List.FilterByBoolMask(list=filterByBoolMask.in, mask=isNull)
watch = Watch(filterByBoolMask_3.out)
filterByBoolMask_4 = List.FilterByBoolMask(list=toNumber, mask=isNull)
watch_2 = Watch(filterByBoolMask_4.out)
code_block_4 = CodeBlock { 1000; }
lt = watch_2 < code_block_4
filterByBoolMask_5 = List.FilterByBoolMask(list=watch, mask=lt)
watch_3 = Watch(filterByBoolMask_5.in)
RunMe = Input(RunMe:bool=false)  # Set True for execute command
battleBIM = Custom[RunMe.BattleBIM](list=watch_3, runMe=RunMe)  # This Custom node will return input if runMe set to True
delete = File.Delete(battleBIM)
python_script = Python(IN[0]=watch_3)
# ---------- python_script.python (12 lines) ----------
#Copyright © 2017, Lingkon
# http://BattleBIM.blogspot.com
# @Lingkon, lingkonn@gmail.com
####################################
li = IN[0]
li2 = []

for x in li:
	li2.append(x)
	
#Assign your output to the OUT variable.
OUT = li2
# ----------------------------------------
BackupFilePath = Output(python_script)  # BackupFilePath
python_script_2 = Python(IN[0]=watch_3)
# ---------- python_script_2.python (19 lines) ----------
#Copyright © 2017, Lingkon
# http://BattleBIM.blogspot.com
# @Lingkon, lingkonn@gmail.com
####################################

import sys
sys.path.append(r'C:\Program Files (x86)\IronPython 2.7\Lib')
import os
####################################
filePaths = IN[0]
fileSize = [os.path.getsize(eachIteam) for eachIteam in filePaths]

####################################
finalFileSize = []#empty list
for eachIteam in fileSize:#converting to MB
	finalFileSize.append(float(eachIteam)/pow(1024,2))
	
####################################
OUT = finalFileSize, "Total = "+str(round(sum(finalFileSize),2))+" MB", "Total = "+str(round(sum(finalFileSize)/1024,3))+" GB"
# ----------------------------------------
code_block_5 = CodeBlock(o=python_script_2) { o[1]; }
FileSizeInMB = Output(code_block_5)
refresh = Input(refresh:bool=true)
