# Dynamo custom node Revit_Room.FromExcel (BattleBIM).dyf "Room.FromExcel (BattleBIM)" (Dynamo 1.3.0.875)
# category: BattleBIM.Revit.Room
# This custom node create rooms in bulk from excel (provided template) file

string = StringInput("""import clr
clr.AddReference('ProtoGeometry')
from Autodesk.DesignScript.Geometry import *

clr.AddReference("RevitNodes")
import Revit
clr.ImportExtensions(Revit.Elements)

clr.ImportExtensions(Revit.GeometryConversion)

clr.AddReference("RevitServices")
import RevitServices
from RevitServices.Persistence import DocumentManager
from RevitServices.Transactions import TransactionManager
from System.Collections.Generic import *

clr.AddReference("RevitAPI")
import Autodesk
from Autodesk.Revit.DB import *

doc = DocumentManager.Instance.CurrentDBDocument
uiapp = DocumentManager.Instance.CurrentUIApplication
app = uiapp.Application
uidoc=DocumentManager.Instance.CurrentUIApplication.ActiveUIDocument

select = []
elements = UnwrapElement(IN[0])
uisel = uidoc.Selection
result = []

for i in elements:
 select.append(i.Id)
 Icollection = List[ElementId](select)
 uisel.SetElementIds(Icollection)
 result.append("Seccess")
OUT = result""")
path = Input()
fromPath = FileObject(path)  # "File.FromPath"
string_2 = StringInput("Room")
boolean = BoolSelector(true)
readFromFile = Excel.ReadFromFile(file=fromPath, sheetName=string_2, readAsStrings=boolean)
levels = Levels("Level 1")
code_block = CodeBlock(readFromFile, levels)
# ---------- code_block.designscript (7 lines) ----------
rmName = DSCore.List.GetItemAtIndex(a<2>,1);
l1 = rmName[1..DSCore.List.Count(rmName)-1];

rmNumber = DSCore.List.GetItemAtIndex(a<2>,2);
l2 =rmNumber[1..DSCore.List.Count(rmNumber)-1];

Revit.Room.ByLocation(lvl<1L>, Autodesk.Point.ByCoordinates(0)<1L>, l1<1L>, l2<1L>);
# ----------------------------------------
reset = Input(reset:bool=true)
python_script_from_string = PythonStringNode(script=string, IN[0]=code_block.out4, IN[1]=reset)
Rooms = Output(code_block.out4)
RoomName = Output(code_block.l1)
RoomNumber = Output(code_block.l2)
