# Dynamo custom node Revit_Section.ByCurve.dyf "Section.ByCurve (BattleBIM)" (Dynamo 1.2.0.2690)
# category: BattleBIM.Revit.Views.SectionsView.Create
# This custom node will create section view based on curve

curves = Input(curves : Curve)
numberOfSection = Input(numberOfSection : int)
code_block = CodeBlock(numberOfSection=numberOfSection) { 0..1..#numberOfSection; }
pointAtParameter = Curve.PointAtParameter(curve=curves, param=code_block, lacing=CrossProduct)
normalAtParameter = Curve.NormalAtParameter(curve=curves, param=code_block, lacing=CrossProduct)
code_block_2 = CodeBlock { Vector.ZAxis(); }
byOriginVectors = CoordinateSystem.ByOriginVectors(origin=pointAtParameter, xAxis=normalAtParameter, yAxis=code_block_2)
right = Input(right : int)
left = Input(left : int)
bottom = Input(bottom : int)
top = Input(top : int)
FarClipOffset = Input(FarClipOffset : int)
code_block_3 = CodeBlock(Right=right, Left=left, bottom=bottom, Top=top, FarClipOffset=FarClipOffset) { {-Right,Left}; {-bottom,Top}; {0,FarClipOffset}; }
byCoordinates = Point.ByCoordinates(x=code_block_3.out0, y=code_block_3.out1, z=code_block_3.out2)
code_block_4 = CodeBlock(p=byCoordinates) { p[0]; p[1]; }
byCoordinateSystemMinPointMaxPoint = SectionView.ByCoordinateSystemMinPointMaxPoint(byOriginVectors, code_block_4.out0, code_block_4.out1)
SectionView = Output(byCoordinateSystemMinPointMaxPoint)
