# Dynamo custom node Revit_TopographyToPolySurface(BattleBIM).dyf "TopographyToPolySurface(BattleBIM)" (Dynamo 1.2.0.2831)
# category: BattleBIM.Revit.Element.Topography.Actions
# This custom node will convert Topography to PolySurface

Topography = Input()
# note: #Copyright © 2016, Lingkon
# # @Lingkon, lingkonn@gmail.com
# ###############################
code_block = CodeBlock(mes=Topography)
# ---------- code_block.designscript (4 lines) ----------
mo = mes.Mesh;
m = mo.FaceIndices;
p1 = mo.VertexPositions;
PolySurface.ByJoinedSurfaces(Surface.ByPerimeterPoints(List.Transpose({List.GetItemAtIndex(p1,m.A),List.GetItemAtIndex(p1,m.B),List.GetItemAtIndex(p1,m.C)})));
# ----------------------------------------
PolySurface = Output(code_block.out3)
