# Dynamo custom node Revit_TopographyToSurface(BattleBIM).dyf "TopographyToSurface(BattleBIM)" (Dynamo 1.2.0.2831)
# category: BattleBIM.Revit.Element.Topography.Actions
# This custom node will convert Topography to surface

# note: #Copyright © 2016, Lingkon
# # @Lingkon, lingkonn@gmail.com
# ###############################
topography = Input(topography : Topography)
mesh = Topography.Mesh(topography)
vertexPositions = Mesh.VertexPositions(mesh)
faceIndices = Mesh.FaceIndices(mesh)
A = IndexGroup.A(faceIndices)
getItemAtIndex = List.GetItemAtIndex(list=vertexPositions, index=A)
B = IndexGroup.B(faceIndices)
getItemAtIndex_2 = List.GetItemAtIndex(list=vertexPositions, index=B)
C = IndexGroup.C(faceIndices)
getItemAtIndex_3 = List.GetItemAtIndex(list=vertexPositions, index=C)
create = List.Create(getItemAtIndex, getItemAtIndex_2, getItemAtIndex_3)
transpose = List.Transpose(create)
byPerimeterPoints = Surface.ByPerimeterPoints(transpose)
Surface = Output(byPerimeterPoints)
