# Dynamo custom node Revit_UnusedSheet.Schedule.dyf "UnusedSheet.Schedule" (Dynamo 1.2.1.3083)
# category: BattleBIM.Revit.Views.Sheet
# This custom node will generate a schedule of unused sheets in the current document

don_t_touch = StringInput("""import clr

clr.AddReference("RevitServices")
from RevitServices.Persistence import DocumentManager
doc = DocumentManager.Instance.CurrentDBDocument

clr.AddReference("RevitNodes")
import Revit
clr.ImportExtensions(Revit.Elements)

clr.AddReference("RevitAPI")
from Autodesk.Revit.DB import *

def tolist(obj1):
 if hasattr(obj1,"__iter__"): return obj1
 else: return [obj1]

def output1(l1):
 if len(l1) == 1: return l1[0]
 else: return l1

sheets = UnwrapElement(tolist(IN[0]))
sheet_views, sheets_scheds = [], []
rev_str = "<Revision Schedule>"
sched_dict = dict()
fec1 = FilteredElementCollector(doc).OfClass(ScheduleSheetInstance)
for s in fec1:
 if rev_str not in s.Name:
  key = s.OwnerViewId.IntegerValue
  if key not in sched_dict:
   sched_dict[key] = [s]
  else:
   sched_dict[key].append(s)

for i in xrange(len(sheets) ):
 viewsid = sheets[i].GetAllPlacedViews()
 views = [doc.GetElement(v).ToDSType(True) for v in viewsid]
 sheet_views.append(views)
 s_id = sheets[i].Id.IntegerValue
 scheds = sched_dict[s_id] if s_id in sched_dict else []
 sheets_scheds.append(scheds)
OUT = output1(sheet_views), output1(sheets_scheds)""")
reset = Input(reset:bool=true)
code_block = CodeBlock()
# ---------- code_block.designscript (3 lines) ----------
Category.ByName(
"OST_Sheets");
"Sheet Number";
# ----------------------------------------
code_block_2 = CodeBlock(reset, code_block.out0)
# ---------- code_block_2.designscript (9 lines) ----------
a;
b;
[Imperative]
{
 if(a==true)
  return=b;
 else
  return=b;
};
# ----------------------------------------
all_elements_of_category = ElementsOfCategory(code_block_2.out2)
watch = Watch(all_elements_of_category)
python_script_from_string = PythonStringNode(script=don_t_touch, IN[0]=watch)
code_block_3 = CodeBlock(i=python_script_from_string) { i[0]; i[1]; }
watch_2 = Watch(code_block_3.out0)
code_block_4 = CodeBlock(watch_2, watch) { num = DSCore.List.Count(i<1L>); fndZero = DSCore.List.AllIndicesOf(num,0); DSCore.List.GetItemAtIndex(sht,fndZero); }
python_script_from_string_2 = PythonStringNode(script=don_t_touch, IN[0]=code_block_4.out2)
code_block_5 = CodeBlock(i=python_script_from_string_2) { i[1]; }
watch_3 = Watch(code_block_5)
code_block_6 = CodeBlock(watch_3, code_block_4.out2) { num = DSCore.List.Count(i<1L>); fndZero = DSCore.List.AllIndicesOf(num,0); DSCore.List.GetItemAtIndex(sht,fndZero); }
code_block_7 = CodeBlock(l=code_block_6.out2)
# ---------- code_block_7.designscript (4 lines) ----------
l.GetParameterValueByName("Sheet Name");
l.GetParameterValueByName("Sheet Number");
l.GetParameterValueByName("Sheet Group");
l.Id;
# ----------------------------------------
code_block_8 = CodeBlock(li1=code_block_7.out0, li2=code_block_7.out2) { li = DSCore.List.GroupByKey(li1, li2); __TryGetValueFromNestedDictionaries(li, "groups"); }
element_id = Watch(code_block_7.out3)
ID = Output(element_id)
sheet_number = Watch(code_block_7.out1)
sheetNumber = Output(sheet_number)
sheet_name = Watch(code_block_7.out0)
sheetName = Output(sheet_name)
sheet_group = Watch(code_block_7.out2)
sheetGroup = Output(sheet_group)
unused_sheets = List.Count(code_block_6.out2)
unusedSheets = Output(unused_sheets)
sheets = List.Count(watch)
allSheets = Output(sheets)
file_path = Filename(".\ScheduleOfUnusedSheetsInTheCurrentProject.xlsx")
code_block_9 = CodeBlock { "UnusedSheets"; 1; 0; }
serial_number = CodeBlock(num=unused_sheets) { 1..num; }
create = List.Create(serial_number, sheet_number, sheet_name, sheet_group, element_id)
transpose = List.Transpose(create)
writeToFile = Excel.WriteToFile(filePath=file_path, sheetName=code_block_9.out0, startRow=code_block_9.out1, startCol=code_block_9.out2, data=transpose)
data = Output(writeToFile)
code_block_10 = CodeBlock {  }
