# Dynamo custom node Revit_ViewSheetSet From Document (BattleBIM).dyf "ViewSheetSet From Document (BattleBIM)" (Dynamo 1.3.0.875)
# category: BattleBIM.Revit.Views.Sheet.Query
# This custom node retrive View/Sheet Set  from Link/Current document

document = Input()  # Can be used link file Autodesk.Revit.DB.Document
reset = Input(reset:bool=true)
python_script = Python(IN[0]=document, IN[1]=reset)
# ---------- python_script.python (25 lines) ----------
#Copyright(c) 2015, Konrad Sobon
# @arch_laboratory, http://archi-lab.net

import clr
clr.AddReference('ProtoGeometry')
from Autodesk.DesignScript.Geometry import *

# Import DocumentManager and TransactionManager
clr.AddReference("RevitServices")
import RevitServices
from RevitServices.Persistence import DocumentManager
from RevitServices.Transactions import TransactionManager

doc = IN[0]

# Import RevitAPI
clr.AddReference("RevitAPI")
import Autodesk
from Autodesk.Revit.DB import *
import System

vs = FilteredElementCollector(doc).OfClass(ViewSheetSet)

#Assign your output to the OUT variable
OUT = [i.Name for i in vs]
# ----------------------------------------
ViewSheetSet = Output(python_script)
