# Dynamo custom node Revit_ViewSheetSet To Sheet (BattleBIM).dyf "ViewSheetSet To Sheet (BattleBIM)" (Dynamo 1.3.0.875)
# category: BattleBIM.Revit.Views.Sheet.Query
# This custom node retrieve all sheets available in the ViewSheetSet

ViewSheetSet = Input(ViewSheetSet:string)
document = Input()  # Can be used link file Autodesk.Revit.DB.Document
reset = Input(reset:bool=true)
python_script = Python(IN[0]=ViewSheetSet, IN[1]=document, IN[2]=reset)
# ---------- python_script.python (37 lines) ----------
#Copyright(c) 2015, Konrad Sobon
# @arch_laboratory, http://archi-lab.net

import clr
clr.AddReference('ProtoGeometry')
from Autodesk.DesignScript.Geometry import *

# Import DocumentManager and TransactionManager
clr.AddReference("RevitServices")
import RevitServices
from RevitServices.Persistence import DocumentManager
from RevitServices.Transactions import TransactionManager

doc = IN[1]

# Import Element wrapper extension methods
clr.AddReference("RevitNodes")
import Revit
clr.ImportExtensions(Revit.Elements)

# Import RevitAPI
clr.AddReference("RevitAPI")
import Autodesk
from Autodesk.Revit.DB import *

vsName = IN[0]

viewSets = FilteredElementCollector(doc).OfClass(ViewSheetSet)

for i in viewSets:
	if i.Name == vsName:
		vs = i
	else:
		continue

#Assign your output to the OUT variable
OUT = [i.ToDSType(True) for i in vs.Views]
# ----------------------------------------
Sheet = Output(python_script)
