# Dynamo custom node Revit_Wall.Dimension(BattleBIM).dyf "Wall.Dimension(BattleBIM)" (Dynamo 1.3.0.875)
# category: BattleBIM.Revit.Dimension
# This Custom node will place Dimension of core of walls

reset = Input(reset:bool=true)
get_revit_activeview = Custom[Get Revit ActiveView](reset=reset)  # Active View
selectWalls = Input()
watch = Watch(selectWalls)
code_block = CodeBlock(watch) { El.GetCategory; }
string_from_object = FromObject(code_block)
code_block_2 = CodeBlock(li=string_from_object, li2=watch) { ind = List.AllIndicesOf(li,"Walls"); elm = li2[ind]; fNl = {elm[0],elm[List.Count(elm)-1]}; {elm,fNl}; }
selectModelCurves = Input()
watch_2 = Watch(selectModelCurves)
curves = Element.Curves(watch_2)
suffix = Input()  # "suffix="""
prefix = Input()
byElements = Dimension.ByElements(get_revit_activeview, code_block_2.out3, curves, suffix, prefix)
Dimension = Output(byElements)
