# Dynamo custom node String.AllIndicesOfBasedOnPartialMatch.dyf "String.AllIndicesOfBasedOnPartialMatch (BattleBIM)" (Dynamo 1.3.0.875)
# category: BattleBIM.String
# Find Indexes in list Based on partial string
# ** Search For Single Item
# ** Use List.UniqueItems node if show repeated Indices

items = Input()  # String
string_from_object = FromObject(items)
searchFor = Input()  # String
string_from_object_2 = FromObject(searchFor)
reset = Input(reset:bool = true)
python_script = Python(IN[0]=string_from_object, IN[1]=string_from_object_2, IN[2]=reset)
# ---------- python_script.python (7 lines) ----------
import clr
clr.AddReference('ProtoGeometry')
from Autodesk.DesignScript.Geometry import *
#The inputs to this node will be stored as a list in the IN variables.
dataEnteringNode = IN
#Assign your output to the OUT variable.
OUT = [i for i, s in enumerate(IN[0]) if IN[1] in s]
# ----------------------------------------
var = Output(python_script)  # "var[]..[]"
