# Dynamo custom node String.AllIndicesOfBasedOnPartialMatch_Multiple.dyf "String.AllIndicesOfBasedOnPartialMatch(BattleBIM)-Multiple" (Dynamo 1.2.0.2831)
# category: BattleBIM.String
# Find Indexes in list Based on partial string
# ** Search For Multiple Item
# ** Use List.UniqueItems node if show repeated Indices

items = Input()  # String
searchFor = Input()  # String
reset = Input(reset:bool = true)
allindicesofbasedonpartialstring = Custom[AllIndicesOfBasedOnPartialStringMatch (BattleBIM)](items=items@L2, searchFor=searchFor, reset=reset, lacing=Longest)  # Find Indexes in list Based on partial string ** Search For Single Item ** Use List.UniqueItems node if show repeated Indices
var = Output(allindicesofbasedonpartialstring)  # "var[]..[]"
