# Dynamo custom node String.Contain.Letters.dyf "String.Contain.Letters (BattleBIM)?" (Dynamo 1.3.0.875)
# category: BattleBIM.String.Query
# This Custom node will find if list contains letters. Output will be boolean

str = Input()
string_from_array = FromArray(str)
reset = Input(reset:bool = true)
python_script = Python(IN[0]=string_from_array, IN[1]=reset)
# ---------- python_script.python (7 lines) ----------
#Copyright © 2016, Lingkon
# @Lingkon, lingkonn@gmail.com
###############################
str = IN[0]

xx = any(l.isalpha() for l in str)
OUT = xx
# ----------------------------------------
boolean = Output(python_script)
