# Dynamo custom node String.Extract Integer.dyf "String.Extract Integer (BattleBIM)" (Dynamo 1.3.0.875)
# category: BattleBIM.String
# This custom node will extract integer from string.
# Example: This is 100 dollar
# result will be 100
# ** Make sure "This is 100 dollar"
# NOT "This is100dollar"

list = Input()  # String For list set Lacing to Longest
string_from_object = FromObject(list)
reset = Input(reset:bool = true)
python_script = Python(IN[0]=string_from_object, IN[1]=reset)
# ---------- python_script.python (2 lines) ----------
str = IN[0]
OUT = [int(s) for s in str.split() if s.isdigit()]
# ----------------------------------------
int = Output(python_script)
