# Dynamo custom node String.ExtractNumberAndInteger.dyf "String.ExtractNumberAndInteger (BattleBIM)" (Dynamo 1.3.0.875)
# category: BattleBIM.String.Actions
# This custom node will extract number and integer from string
# *Set Lacing to Longest if list

str = Input()  # string
string_from_object = FromObject(str)
reset = Input(reset:bool = true)
python_script = Python(IN[0]=string_from_object, IN[1]=reset)
# ---------- python_script.python (6 lines) ----------
#Copyright © 2016, Lingkon
# @Lingkon, lingkonn@gmail.com
###############################
import re
a = IN[0]
OUT = re.findall(r"[-+]?\d*\.\d+|\d+", a)
# ----------------------------------------
num_int = Output(python_script)  # "num/int"
