# Dynamo custom node String.FilterTree(BattleBIM).dyf (Dynamo 1.3.0.875)
# category: BattleBIM.String.Query
# Filter multiple items from nested list as you type

str = Input()  # String
string_from_object = FromObject(str)
flatten = Flatten(string_from_object)
searchFor = Input()  # String
string_from_object_2 = FromObject(searchFor)
flatten_2 = Flatten(string_from_object_2)
ignoreCase = Input(ignoreCase:bool=true)  # Set True for partial match and False for exact match
contains = String.Contains(str=flatten, searchFor=flatten_2, ignoreCase=ignoreCase, lacing=CrossProduct)
flatten_3 = Flatten()  # unwired: arg0
map = List.Map(list=contains, f_x=flatten_3)
formula = Formula("x=1")  # unwired: arg0
trueForAny = TrueForAny(arg1=formula)  # unwired: arg0
# note: #Copyright © 2016, Lingkon
# # @Lingkon, lingkonn@gmail.com
# ###############################
map_2 = List.Map(list=map, f_x=trueForAny)
count = List.Count(string_from_object, lacing=Longest)
chop = List.Chop(list=map_2, lengths=count)
filterByBoolMask = List.FilterByBoolMask(list=string_from_object, mask=chop)
boolean = BoolSelector(false)
clean = List.Clean(list=filterByBoolMask.in, preserveIndices=boolean)
flatten_4 = Flatten(clean)
watch = Watch(flatten_4)
Match = Output(watch)
watch_2 = Watch(filterByBoolMask.out)
Others = Output(watch_2)
