# Dynamo custom node String.GetItemAtIndex (BattleBIM).dyf (Dynamo 1.3.0.875)
# category: BattleBIM.String
# Get String At Index
# ** If list set Lacing to Longest

str = Input()
string_from_object = FromObject(str)
startIndex = Input(startIndex:int)
endIndex = Input(endIndex:int)
refresh = Input(refresh:bool=true)
python_script = Python(IN[0]=string_from_object, IN[1]=startIndex, IN[2]=endIndex, IN[3]=refresh)
# ---------- python_script.python (17 lines) ----------
#Copyright © 2017, Lingkon
# @Lingkon, lingkonn@gmail.com
###############################


import clr
clr.AddReference('ProtoGeometry')
from Autodesk.DesignScript.Geometry import *
#The inputs to this node will be stored as a list in the IN variables.
dataEnteringNode = IN
s = IN[0]

startIn = IN[1]
endIn = IN[2]

#Assign your output to the OUT variable.
OUT = s[startIn:endIn]
# ----------------------------------------
OUT = Output(python_script)
