# Dynamo custom node String.RemoveFirstAndLast.dyf "String.RemoveFirstAndLast (BattleBIM)" (Dynamo 1.2.0.2514)
# category: BattleBIM.String.Create
# This Custom Node will removed First and Last if match letters

str = Input(str:string)
letterToRemove = Input(letterToRemove:string)
reset = Input(reset:bool = true)
python_script = Python(IN[0]=str, IN[1]=letterToRemove, IN[2]=reset)
# ---------- python_script.python (8 lines) ----------
#Copyright © 2016, Lingkon
# @Lingkon, lingkonn@gmail.com
###############################
rawText = str(IN[0])
toBeRemove_list = str(IN[1])


OUT = rawText.strip(toBeRemove_list)
# ----------------------------------------
str_2 = Output(python_script)  # "str"
