# Dynamo custom node String.Sort.dyf "String.Sort (BattleBIM)" (Dynamo 1.2.0.2514)
# category: BattleBIM.String.Create
# String (Text) Sort

String = Input()
reset = Input(reset:bool = true)
python_script = Python(IN[0]=String, IN[1]=reset)
# ---------- python_script.python (11 lines) ----------
#Copyright © 2016, Lingkon
# @Lingkon, lingkonn@gmail.com
###############################

x=IN[0]
import re
def sort(x): 
    convertText = lambda text: int(text) if text.isdigit() else text.lower() 
    Textkey = lambda key: [ convertText(c) for c in re.split('([0-9]+)', key) ] 
    return sorted(x, key = Textkey)
OUT = sort(x)
# ----------------------------------------
String_2 = Output(python_script)  # "String"
