# Dynamo custom node String.Trim.dyf "String.Trim (BattleBIM)" (Dynamo 1.2.0.2642)
# category: BattleBIM.String.Actions
# This custom node will remove all characters after a given character

str = Input(str : string)
trimBy = Input(trimBy : string)
reset = Input(reset:bool = true)
python_script = Python(IN[0]=str, IN[1]=trimBy, IN[2]=reset)
# ---------- python_script.python (7 lines) ----------
#Copyright © 2016, Lingkon
# @Lingkon, lingkonn@gmail.com
###############################
mainString = IN[0]
cuttingObject = IN[1]
h, m, t = mainString.partition(cuttingObject)
OUT = h, m, t
# ----------------------------------------
code_block = CodeBlock(a=python_script) { a[0]; a[1]; a[2]; }
fristPortion = Output(code_block.out0)
tool = Output(code_block.out1)
lastPortion = Output(code_block.out2)
