# Dynamo custom node String_IntToStr.LeadingAnyChars(BattleBIM).dyf "IntToStr.LeadingAnyChars(BattleBIM)" (Dynamo 1.3.0.875)
# category: BattleBIM.String.Actions
# This custom node will convert integer to string with leading zeros on the left.
# **For list change Lacing to Longest

# note: #Copyright © 2016, Lingkon
# # @Lingkon, lingkonn@gmail.com
# ###############################
list = Input(list:var[]..[])  # List to pad
string_from_object = FromObject(list)
width = Input(width: int="")  # Num of pad
padChars = Input()  # Character to pad with, defaults to space
string_from_object_2 = FromObject(padChars)
padLeft = String.PadLeft(string_from_object, width, string_from_object_2)
str = Output(padLeft)
