# Dynamo custom node String_IntToStr.LeadingZeros(Py)(BattleBIM).dyf "IntToStr.LeadingZeros(Py)(BattleBIM)" (Dynamo 1.2.0.2831)
# category: BattleBIM.String.Actions
# This custom node will convert integer to string with leading zeros on the left.
# **For list change Lacing to Longest

list = Input(list:var[]..[])  # List to add Zeros
width = Input(width: int=2)  # Num of Zeros
reset = Input(reset:bool = true)
python_script = Python(IN[0]=list, IN[1]=width, IN[2]=reset)
# ---------- python_script.python (7 lines) ----------
#Copyright © 2016, Lingkon
# @Lingkon, lingkonn@gmail.com
###############################

#integer as string with leading zeros

OUT = format(IN[0], '0'+str(IN[1]+1)+'d')
# ----------------------------------------
str = Output(python_script)
