# Dynamo custom node Collector.RoomFromElements.dyf (Dynamo 1.0.0.1180)
# category: BlackBox.Collection
# Feed elements into this node and get the Rooms they are in. This uses the Revit API property of Room that each elemant inherits.

Elements = Input()
Phase_string = Input()  # "Phase [string]"
collector_room_from_elements = Python(IN[0]=Elements, IN[1]=Phase_string)
# ---------- collector_room_from_elements.python (64 lines) ----------
#Copyright(c) 2014, Jason Andersen, jason@serialnonstandard.com

# Default imports
import clr
# Import RevitAPI
clr.AddReference("RevitAPI")
import Autodesk
from Autodesk.Revit.DB import *
import System.Collections.Generic
from System.Collections.Generic import List
# Import DocumentManager and TransactionManager
clr.AddReference("RevitServices")
import RevitServices
from RevitServices.Persistence import DocumentManager
from RevitServices.Transactions import TransactionManager
# Import ToDSType(bool) extension method
clr.AddReference("RevitNodes")
import Revit
clr.ImportExtensions(Revit.Elements)
doc =  DocumentManager.Instance.CurrentDBDocument
app =  DocumentManager.Instance.CurrentUIApplication.Application

#phase coming in
elementz = IN[0]
phaseProject = IN[1]

phase = []
collector = FilteredElementCollector(doc)
phase_collector = collector.OfClass(Phase)

for i in phase_collector:
	if i.Name == phaseProject:
  		phase = i
  	else:
 		print("Phase not found")

#unwrapelements
elements = []
for i in elementz:
    elements.append(UnwrapElement(i))

#variables
output = []
roomelems = []
elemNotInRooms = []

#work
for f in elements:
	fi = (f)
	fs = fi.Symbol
	fm = fi.Symbol.Family
	room = fi.Room[phase]

	if room != None:
		roomelems.append(room)
	else:
		elemNotInRooms.append(fi)
		continue
	
output.append(roomelems)
output.append(elemNotInRooms)
	
#Assign your output to the OUT variable
OUT = output
# ----------------------------------------
code_block = CodeBlock(elements=collector_room_from_elements, elements_not_in_room=collector_room_from_elements) { elements[0]; elements_not_in_room[1]; }
Room_Elements = Output(code_block.out0)
Elements_Not_In_Rooms = Output(code_block.out1)
