# Dynamo custom node Get.CurtainPanelByLevel.dyf (Dynamo 0.9.0.3067)
# category: BlackBox.Get
# Select curtain panels by the level they are on. These panels will look to the wall they are hosted in and use the Base Constraint. This hurdles the difficulties in door and windows not reading the level corectly.

Level = Input()
python_script = Python(IN[0]=Level)
# ---------- python_script.python (49 lines) ----------
#Copyright(c) 2014, Jason Andersen, jason@serialnonstandard.com 
import clr

# Import RevitAPI
clr.AddReference("RevitAPI")
import Autodesk
from Autodesk.Revit.DB import *

# Import DocumentManager and TransactionManager
clr.AddReference("RevitServices")
import RevitServices
from RevitServices.Persistence import DocumentManager
from RevitServices.Transactions import TransactionManager

# Import ToDSType(bool) extension method
clr.AddReference("RevitNodes")
import Revit
clr.ImportExtensions(Revit.Elements)
clr.ImportExtensions(Revit.GeometryConversion)

import clr
clr.AddReference('ProtoGeometry')
from Autodesk.DesignScript.Geometry import *

doc =  DocumentManager.Instance.CurrentDBDocument
app =  DocumentManager.Instance.CurrentUIApplication.Application

#levels coming in
level = IN[0]

fec = FilteredElementCollector(doc)
fec.OfCategory(BuiltInCategory.OST_CurtainWallPanels)
fec.OfClass(FamilyInstance)
 
famTypeItr = fec.GetElementIdIterator()
famTypeItr.Reset()

#global Variables
cpAtLevel = []
error =[]

for item in famTypeItr:
	famInst = doc.GetElement(item)
	if famInst.Host.Parameter["Base Constraint"].AsValueString() == level.Name.ToString():
		cpAtLevel.append(famInst)
	else:
		error.append("appears to be no Curtain Panels here...")
#Assign your output to the OUT variable
OUT =  cpAtLevel,error
# ----------------------------------------
Curtain_Panels = Output(python_script)
