# Dynamo custom node Get.ElevationsWithoutMarker.dyf (Dynamo 0.8.1.1942)
# category: BlackBox.Get

Elev_element = Input()  # "Elev [element]"
python_script = Python(IN[0]=Elev_element)
# ---------- python_script.python (35 lines) ----------
#Copyright(c) 2014, Jason Andersen, andersen.ja@gmail.com
# Default imports
import clr
# Import RevitAPI
clr.AddReference("RevitAPI")
import Autodesk
from Autodesk.Revit.DB import *
# Import DocumentManager and TransactionManager
clr.AddReference("RevitServices")
import RevitServices
from RevitServices.Persistence import DocumentManager
from RevitServices.Transactions import TransactionManager
# Import ToDSType(bool) extension method
clr.AddReference("RevitNodes")
import Revit
clr.ImportExtensions(Revit.Elements)
doc =  DocumentManager.Instance.CurrentDBDocument
app =  DocumentManager.Instance.CurrentUIApplication.Application

#The input to this node will be stored in the IN[0] variable and unwrap element
elements = UnwrapElement(IN[0])

#variables
elemsNotElevation = []
elemsHasElevation = []

#iterate through list and sort
for e in elements:
	if e.HasElevations() == False:
		elemsNotElevation.append(e)
	else:
		elemsHasElevation.append(e)

#Assign your output to the OUT variable
OUT = elemsNotElevation, elemsHasElevation
# ----------------------------------------
code_block = CodeBlock { 0; 1; }
getItemAtIndex = List.GetItemAtIndex(list=python_script, index=code_block.out1)
Elements_w_Marker = Output(getItemAtIndex)
getItemAtIndex_2 = List.GetItemAtIndex(list=python_script, index=code_block.out0)
Elements_w_o_Marker = Output(getItemAtIndex_2)  # "Elements w/o Marker"
