# Dynamo custom node Get.NestedFamily.dyf (Dynamo 0.9.0.3067)
# category: BlackBox.Get
# This node uses the SuperComponent and SubComponets properties of Revit API to organize the elements into lists based on there make-up. I haven't tested multiple nested families but have found it helpfull esp. on Doors, Plumbing Fixtures, & Casework to find out which family is nested in which parent

Elements = Input()
flatten = Flatten(Elements)
# note: Getting the Nest Elements and SuperComponents....
python_script = Python(IN[0]=flatten)
# ---------- python_script.python (56 lines) ----------
#Copyright(c) 2014, Jason Andersen, andersen.ja@gmail.com

# Default imports
import clr
# Import RevitAPI
clr.AddReference("RevitAPI")
import Autodesk
from Autodesk.Revit.DB import *
import System.Collections.Generic
from System.Collections.Generic import List
# Import DocumentManager and TransactionManager
clr.AddReference("RevitServices")
import RevitServices
from RevitServices.Persistence import DocumentManager
from RevitServices.Transactions import TransactionManager
# Import ToDSType(bool) extension method
clr.AddReference("RevitNodes")
import Revit
clr.ImportExtensions(Revit.Elements)
doc =  DocumentManager.Instance.CurrentDBDocument
app =  DocumentManager.Instance.CurrentUIApplication.Application

#phase coming in
elementIN = IN[0]

#unwrapelements
elements = []
for i in elementIN:
    elements.append(UnwrapElement(i))

#variables
output = []
parents = []
superComponents = []
error = []

#work
for f in elements:
	try:
		elemlist = []
		for elemid in f.GetSubComponentIds():
			elemlist.append(doc.GetElement(elemid))
		superComponents.append(elemlist)
		if f.SuperComponent == None:
			parents.append(f)
		else:
			continue
	except:
		error.append("Something Wrong Here")
		error.append(f)		
		
output.append(parents)
output.append(superComponents)
output.append(error)

OUT = output
# ----------------------------------------
number = DoubleInput(0)
getItemAtIndex = List.GetItemAtIndex(list=python_script, index=number)
Parent_Family = Output(getItemAtIndex)
number_2 = DoubleInput(1)
getItemAtIndex_2 = List.GetItemAtIndex(list=python_script, index=number_2)
flatten_2 = Flatten(getItemAtIndex_2)
Nested_Family = Output(flatten_2)
# note: Getting the Parents name
python_script_2 = Python(IN[0]=flatten_2)
# ---------- python_script_2.python (45 lines) ----------
#Copyright(c) 2014, Jason Andersen, andersen.ja@gmail.com

# Default imports
import clr
# Import RevitAPI
clr.AddReference("RevitAPI")
import Autodesk
from Autodesk.Revit.DB import *
import System.Collections.Generic
from System.Collections.Generic import List
# Import DocumentManager and TransactionManager
clr.AddReference("RevitServices")
import RevitServices
from RevitServices.Persistence import DocumentManager
from RevitServices.Transactions import TransactionManager
# Import ToDSType(bool) extension method
clr.AddReference("RevitNodes")
import Revit
clr.ImportExtensions(Revit.Elements)
doc =  DocumentManager.Instance.CurrentDBDocument
app =  DocumentManager.Instance.CurrentUIApplication.Application

#phase coming in
elementIN = IN[0]

#unwrapelements
elements = []
for i in elementIN:
    elements.append(UnwrapElement(i))

#variables
output = []
parentNames = []

#work
for f in elements:
	if f.SuperComponent != None:
		s = f.SuperComponent
		parentNames.append(s.Symbol.Family.Name)
	else:
		continue
		
output.append(parentNames)

OUT = output
# ----------------------------------------
flatten_3 = Flatten(python_script_2)
Parents_Name_of_nested_family = Output(flatten_3)  # "Parents Name [of nested family]"
categoryName = Custom[Get.CategoryName](Elements=flatten_2)  # Get the category of an element
Category_Name_of_nested_family = Output(categoryName)  # "Category Name [of nested family]"
number_3 = DoubleInput(2)
getItemAtIndex_3 = List.GetItemAtIndex(list=python_script, index=number_3)
flatten_4 = Flatten(getItemAtIndex_3)
Error_s = Output(flatten_4)  # "Error(s)"
