# Dynamo custom node BPCustomHome.dyf (Dynamo 0.9.0.3067)
# category: Revit.Elements
# Create a Custom Home from linework. To Start, Draw Lines on Foundation Plan.

SELECT_LINE_ELEMENTS_ON_FOUNDATION_PLAN = Input()
curves = Element.Curves(SELECT_LINE_ELEMENTS_ON_FOUNDATION_PLAN)
flatten = Flatten(curves)

# group: EXTERIOR BASEMENT WALLS
levels = Levels("T/O 1ST FLOOR")
levels_2 = Levels("T/O FOOTING")
basement_wall_type = WallTypes("CMU - 10\"")

elevation = Level.Elevation(levels)
elevation_2 = Level.Elevation(levels_2)
sub = elevation - elevation_2
byCurveAndHeight = Wall.ByCurveAndHeight(curve=flatten, height=sub, level=levels_2, wallType=basement_wall_type)
curves_2 = Element.Curves(SELECT_LINE_ELEMENTS_ON_FOUNDATION_PLAN)
flatten_2 = Flatten(curves_2)
ZAxis = Vector.ZAxis()
translate = Geometry.Translate(geometry=flatten_2, direction=ZAxis, distance=sub)

# group: EXTERIOR 1ST FLOOR WALLS
levels_3 = Levels("U/S 2ND FLOOR")
levels_4 = Levels("T/O 1ST FLOOR")
n1st_floor_wall_type = WallTypes("Brick on 2x6 Wood Stud - 1\" Rigid Ins")  # "1ST FLOOR WALL TYPE"

elevation_3 = Level.Elevation(levels_3)
byCurveAndHeight_2 = Wall.ByCurveAndHeight(curve=translate, height=elevation_3, level=levels_4, wallType=n1st_floor_wall_type)

# group: 1ST FLOOR
n1st_floor_type = FloorTypes("9-1/2\" TJI Floor w 3/4\" Sheathing")  # "1ST FLOOR TYPE"
byOutlineTypeAndLevel = Floor.ByOutlineTypeAndLevel(outlineCurves=translate, floorType=n1st_floor_type, level=levels_4)

# group: BASEMENT SLAB
basement_slab_type = FloorTypes("4\" Concrete Slab-on-Grade")
byOutlineTypeAndLevel_2 = Floor.ByOutlineTypeAndLevel(outlineCurves=flatten_2, floorType=basement_slab_type, level=levels_2)

SELECT_PROPERTY_LINE = Input()

# group: TOPOGRAPHY
curves_3 = Element.Curves(SELECT_PROPERTY_LINE)
startPoint = Curve.StartPoint(curves_3)
flatten_3 = Flatten(startPoint)
byPoints = Topography.ByPoints(flatten_3)

ZAxis_2 = Vector.ZAxis()
add = sub + elevation_3
translate_2 = Geometry.Translate(geometry=flatten_2, direction=ZAxis_2, distance=add)

# group: ROOF OUTLINE & FASCIA
byJoinedCurves = PolyCurve.ByJoinedCurves(translate_2)
number_from_feet_and_inches = LengthFromString(0.4064)
boolean = BoolSelector(false)
offset = PolyCurve.Offset(byJoinedCurves, number_from_feet_and_inches, boolean)
number_from_feet_and_inches_2 = LengthFromString(0.1524)
translate_3 = Geometry.Translate(geometry=offset, direction=ZAxis_2, distance=number_from_feet_and_inches_2)
create = List.Create(offset, translate_3)
byLoft = Surface.ByLoft(create)
