# Dynamo custom node RandomPoints2d.dyf (Dynamo 0.7.4.3245)
# category: Geometry.Point.Create
# Creates a random number of points in a given Range

amount = Input()
randomList = Math.RandomList(amount)
Range = Input()
code_block = CodeBlock(x=Range) { -1*x; }
remapRange = Math.RemapRange(randomList, code_block, Range)
shuffle = List.Shuffle(remapRange)
byCoordinates = Point.ByCoordinates(remapRange, shuffle)
Point = Output(byCoordinates)
