# Dynamo graph optimzePointDistance2D.dyn (Dynamo 0.7.4.3245)

code_block = CodeBlock { 10; }
randomPoints2d = Custom[RandomPoints2d](amount=code_block, Range=code_block)  # Creates a random number of points in a given Range
GAnerator4PointDistance = Catalyst.GAnerator.GAnerator4PointDistance(randomPoints2d)
getItemAtIndex = List.GetItemAtIndex(randomPoints2d, GAnerator4PointDistance.out1)
byPoints = PolyCurve.ByPoints(getItemAtIndex)
