# Dynamo graph optimzePointDistance3D.dyn (Dynamo 0.7.4.3245)

code_block = CodeBlock { 10; }
randomPoints3d = Custom[RandomPoints3d](amount=code_block, Range=code_block)  # Creates a random number of points in a given Range
GAnerator4PointDistance = Catalyst.GAnerator.GAnerator4PointDistance(randomPoints3d)
getItemAtIndex = List.GetItemAtIndex(randomPoints3d, GAnerator4PointDistance.out1)
byPoints = PolyCurve.ByPoints(getItemAtIndex)
