# Dynamo custom node Center_line_of_Revit_MEP_Pipe_Improved.dyf (Dynamo 0.9.0.3067)
# category: MGO
# Returns centre line and end points of MEP Pipe

Pipe_Duct_Cable_Tray_Element = Input()
pipe = Python(IN[0]=Pipe_Duct_Cable_Tray_Element)  # "MEP.Pipe"
# ---------- pipe.python (85 lines) ----------
# Copyright(c) 2016, Michail Golubjev
# @damgaard, www.damgaard-ri.dk

import clr

#Import RevitAPI
clr.AddReference("RevitAPI")
import Autodesk
from Autodesk.Revit.DB import *

clr.AddReference('ProtoGeometry')
from Autodesk.DesignScript.Geometry import *

#Import Element wrapper extension methods
clr.AddReference("RevitNodes")
import Revit
clr.ImportExtensions(Revit.Elements)
clr.ImportExtensions(Revit.GeometryConversion)

import sys
pyt_path = r'C:\Program Files (x86)\IronPython 2.7\Lib'
sys.path.append(pyt_path)

from itertools import compress
from itertools import repeat

#The inputs to this node will be stored as a list in the IN variables.
dataEnteringNode = IN

def ProcessList(_func, _list):
	return map( lambda x: ProcessList(_func, x) if type(x)==list else _func(x), _list )
	
def Unwrap(item):
	return UnwrapElement(item)
	
def GetCons(item):
	return item.ConnectorManager.Connectors

def GetType(item):
	return item.ConnectorType

def GetDia(item):
	return item.Radius * 2 * 304.8
	
def GetOrig(item):
	return item.Origin.ToPoint()
	
if isinstance(IN[0], list):
	items = ProcessList(Unwrap, IN[0])
else:
	items = [Unwrap(IN[0])]

try:
	errorReport = None
	conset = ProcessList(GetCons, items)
	
	contype = [[str(GetType(i)) for i in j]for j in conset]
	conmask = [[i == "End" for i in j]for j in contype]
	endcons = [list(compress(i,j)) for i,j in zip(conset,conmask)]
	
	endconsorigin = [[GetOrig(i) for i in j]for j in endcons]
	start = [i[0] for i in endconsorigin]
	end = [i[1] for i in endconsorigin]
	centreline = [Line.ByStartPointEndPoint(i,j) for i,j in zip(start,end)]
	
	conmask = [[i != "End" for i in j]for j in contype]
	othercons = [list(compress(i,j)) for i,j in zip(conset,conmask)]
	otherconsorigin = [[GetOrig(i) for i in j]for j in othercons]
	
	startdia = [GetDia(i[0]) for i in endcons]
	enddia = [GetDia(i[1]) for i in endcons]
		
	output = centreline, start, end, contype, otherconsorigin, startdia, enddia

except:
	# if error occurs anywhere in the process catch it
	import traceback
	errorReport = traceback.format_exc()
		
#Assign your output to the OUT variable.
if errorReport == None:
	OUT = output
	
else:
	OUT = errorReport
# ----------------------------------------
code_block = CodeBlock(lst=pipe)
# ---------- code_block.designscript (14 lines) ----------
//Centre line
lst[0];
//Start point
lst[1];
//End point
lst[2];
//Connector type
lst[3];
//Point of other connectors
lst[4];
//Start diameter
lst[5];
//End diameter
lst[6];
# ----------------------------------------
Centre_line = Output(code_block.out0)
Start_point = Output(code_block.out1)
End_point = Output(code_block.out2)
Connector_type = Output(code_block.out3)
Point_tap_connector = Output(code_block.out4)
Start_diameter = Output(code_block.out5)
End_diameter = Output(code_block.out6)
