# Dynamo custom node All Families Of Category.dyf (Dynamo 1.3.3.4111)
# category: Clockwork.Revit.Selection.ByCollector
# Gets all famiies of a given category in the model  (does *not *work for system families)

category = Input(category : Category)
turn_into_list = Custom[Turn Into List](item=category)  # Turns an element (or a nested list) into a flat list
toggle = Input(toggle : bool = true)
docOrRevitLinkInstance = Input(docOrRevitLinkInstance : var = null)  # Use only if you want to query a linked model
all_family_types_of_category = Custom[All Family Types Of Category](category=turn_into_list, toggle=toggle, docOrRevitLinkInstance=docOrRevitLinkInstance)  # Gets all family types/symbols of a given category in the model (does *not *work for system families)
family = FamilyType.Family(all_family_types_of_category)
uniqueItems = List.UniqueItems(family@L2)
returnListOrSingleValue = Custom[ReturnListOrSingleValue](unknownItem=category, seq=uniqueItems)  # If the unknown item is not a list but rather a single item, only the first item of the list (input "seq") will be returned.
families = Output(returnListOrSingleValue)
