# Dynamo custom node Element.CutGeometry.dyf (Dynamo 1.3.3.4111)
# category: Clockwork.Revit.Elements.Element.Actions
# Adds a solid-solid cut for two model elements (if possible).

elementToBeCut = Input()
turn_into_list = Custom[Turn Into List](item=elementToBeCut)  # Turns an element (or a nested list) into a flat list
cuttingElement = Input()
turn_into_list_2 = Custom[Turn Into List](item=cuttingElement)
python_script = Python(IN[0]=turn_into_list, IN[1]=turn_into_list_2)
# ---------- python_script.python (29 lines) ----------
import clr
clr.AddReference('RevitAPI')
from Autodesk.Revit.DB import *
from System.Collections.Generic import *
clr.AddReference("RevitServices")
import RevitServices
from RevitServices.Persistence import DocumentManager
from RevitServices.Transactions import TransactionManager

doc = DocumentManager.Instance.CurrentDBDocument
items1 = UnwrapElement(IN[0])
items2 = UnwrapElement(IN[1])
i = 0
booleans = list()
TransactionManager.Instance.EnsureInTransaction(doc)
for item1 in items1:
	try:
		SolidSolidCutUtils.AddCutBetweenSolids(doc,item1,items2[i])
		booleans.append(True)
	except:
		try:
			InstanceVoidCutUtils.AddInstanceVoidCut(doc,item1,items2[i])
			booleans.append(True)
		except:
			booleans.append(False)
	i += 1
TransactionManager.Instance.TransactionTaskDone()

OUT = booleans
# ----------------------------------------
returnListOrSingleValue = Custom[ReturnListOrSingleValue](unknownItem=elementToBeCut, seq=python_script)  # If the unknown item is not a list but rather a single item, only the first item of the list (input "seq") will be returned.
success = Output(returnListOrSingleValue)
