# Dynamo custom node Column.AttachTo.dyf (Dynamo 0.9.2.4472)
# category: ABT
# Attaches a column to a target .
# Input may be a single item or a list, make sure the lists are the same length.
# Input:
# Column: columns
# Targets: elements
# TopOrBase: base = 0, top = 1
# cutstyle: CutColumn = 0, CutTarget = 1, None = 2
# justification:  Minimum = 0,  Midpoint = 1, Maximum = 2, Tangent = 3
# offset: positive for shorter length, negative for longer length
# overwrite:  bool per item (it can be different for each column), if true current attachment will be ignored, if false current attachment will remain as it is.

Columns = Input()
Targets = Input()
TopOrBase = Input()
cutstyle = Input()
Justification = Input()
offset = Input()
overwrite = Input()
attach_colum_top_or_base = Python(IN[0]=Columns, IN[1]=Targets, IN[2]=TopOrBase, IN[3]=cutstyle, IN[4]=Justification, IN[5]=offset, IN[6]=overwrite)
# ---------- attach_colum_top_or_base.python (86 lines) ----------
import clr

# Import RevitAPI
clr.AddReference("RevitAPI")
import Autodesk
from Autodesk.Revit.DB import *

# Import DocumentManager and TransactionManager
clr.AddReference("RevitServices")
import RevitServices
from RevitServices.Persistence import DocumentManager
from RevitServices.Transactions import TransactionManager

# Import ToDSType(bool) extension method
clr.AddReference("RevitNodes")
import Revit
clr.ImportExtensions(Revit.Elements)

#def to force item into list even if it is a singel item and unwrap elements to directly acces them
def forcelist(item,tolist):
	#if item 
	try:
		for i in item:
			tolist.append( UnwrapElement( i ))
	except:
		tolist.append(UnwrapElement(item))

columns = []
attachto = []
topOrBase = []
cutStyle = []
justification = []
offset = []
overwrite = []

# Unwrap anf force into list

forcelist(IN[0], columns)
forcelist(IN[1], attachto)
forcelist(IN[2], topOrBase)
forcelist(IN[3], cutStyle)
forcelist(IN[4], justification)
forcelist(IN[5], offset)
forcelist(IN[6], overwrite)

cs= []
for i in cutStyle:
	if i == 0:
		cs.append(Autodesk.Revit.DB.ColumnAttachmentCutStyle.CutColumn)
	elif i == 1:
		cs.append(Autodesk.Revit.DB.ColumnAttachmentCutStyle.CutTarget)
	else:
		cs.append(Autodesk.Revit.DB.ColumnAttachmentCutStyle.None)

ju = []
for i in justification:
	if i == 0:
		ju.append(Autodesk.Revit.DB.ColumnAttachmentJustification.Minimum)
	elif i == 1:
		ju.append(Autodesk.Revit.DB.ColumnAttachmentJustification.Midpoint)
	elif i == 2:
		ju.append(Autodesk.Revit.DB.ColumnAttachmentJustification.Maximum)
	else:
		ju.append(Autodesk.Revit.DB.ColumnAttachmentJustification.Tangent)	
	


# Start Transaction
doc = DocumentManager.Instance.CurrentDBDocument
TransactionManager.Instance.EnsureInTransaction(doc)

xx= []
for idx, e in enumerate(columns):
	try:#no attachment yet
		ColumnAttachment.AddColumnAttachment(doc, e, attachto[idx], topOrBase[idx], cs[idx], ju[idx], (offset[idx]/304.8))

	except:#there in an attachment, if overwrite is true remove and reattach to new target
		if overwrite[idx] == True:
			ColumnAttachment.RemoveColumnAttachment(e, topOrBase[idx])
			ColumnAttachment.AddColumnAttachment(doc, e, attachto[idx], topOrBase[idx], cs[idx], ju[idx], (offset[idx]/304.8))

# End Transaction
TransactionManager.Instance.TransactionTaskDone()

# Wrap
OUT = IN[0]
# ----------------------------------------
Columns_2 = Output(attach_colum_top_or_base)  # "Columns"
