# Dynamo custom node ElementsInWhichRooms.dyf (Dynamo 1.2.1.3083)
# category: Crandle.Element Properties
# This node will check if any of the supplied elements are inside any of the supplied rooms. It will return the list of elements, as well as equal length lists of room numbers, room names, or the rooms themselves.

Elements = Input()
Rooms = Input()
python_script = Python(IN[0]=Elements, IN[1]=Rooms)
# ---------- python_script.python (126 lines) ----------
#Copyright(c) 2015, Konrad Sobon
# @arch_laboratory, http://archi-lab.net

# This code is based on Family.InRoom node originally created
# by Peter Kompolschek and published on Dynamo blog. Big thanks 
# to Peter for sharing his work so graciously.

import clr
import sys
clr.AddReference('ProtoGeometry')
from Autodesk.DesignScript.Geometry import *

pyt_path = r'C:\Program Files (x86)\IronPython 2.7\Lib'
sys.path.append(pyt_path)

# Import ToDSType(bool) extension method
clr.AddReference("RevitNodes")
import Revit
clr.ImportExtensions(Revit.Elements)

# Import DocumentManager and TransactionManager
clr.AddReference("RevitServices")
import RevitServices
from RevitServices.Persistence import DocumentManager
from RevitServices.Transactions import TransactionManager

# Import RevitAPI
clr.AddReference("RevitAPI")
import Autodesk
from Autodesk.Revit.DB import *

doc = DocumentManager.Instance.CurrentDBDocument
uiapp = DocumentManager.Instance.CurrentUIApplication
app = uiapp.Application

#The inputs to this node will be stored as a list in the IN variable.
dataEnteringNode = IN

def TryGetRoom(room, phase):
	try:
		inRoom = room.Room[phase]
	except:
		inRoom = None
		pass
	return inRoom

#def FamiliesInRoom(_room, _families, _doc):
#	outList = []
#	for family in _families:
#		pt = family.Location.Point
		# I suppose it first checks to see if the family is in the room in the defaault phase?
#		if _room.IsPointInRoom(pt):
#			outList.append(family)
#		else:
		#Then if that fails see if its in the room during any of the phases
#			for phase in _doc.Phases:
#				inRoom = TryGetRoom(family, phase)
#				if inRoom != None and inRoom.ToDSType(True).Name == _room.ToDSType(True).Name:
#					outList.append(family)
#	return outList


#Create a list of rooms that any given family is in.
def RoomsWithFamily(_rooms, _family, _doc):
	outList = []
	for _room in _rooms:
		pt = family.Location.Point
		# I suppose it first checks to see if the family is in the room in the defaault phase?
		if _room.IsPointInRoom(pt):
			outList.append(_room)
		else:
		#Then if that fails see if its in the room during any of the phases
			for phase in _doc.Phases:
				inRoom = TryGetRoom(family, phase)
				if inRoom != None and inRoom.ToDSType(True).Name == _room.ToDSType(True).Name:
					outList.append(_room)
	return outList

try:
	errorReport = None
	families = []
	#Unwrap the elements and store them in a array for convenience
	for i in IN[0]:
		families.append(UnwrapElement(i))
	#Unwrap the rooms  and store them in  an array for convenience
	rooms = []
	for i in IN[1]:
		if UnwrapElement(i).Area > 0:
			rooms.append(UnwrapElement(i))
	#Create a list of empty lists of lenth of the number of rooms
	outData = [[] for i in range(len(families))]
	#huh didnt know you could do this (enumerate) but its cools
	#Go through all of the rooms input, and check if the elements are in them. if they are,  add em to de list!
	
	for index, family in enumerate(families):
		roomList = RoomsWithFamily(rooms,family,doc);
		roomNameList = "";
		roomNumberList = "";		
		for _room in roomList:
			if roomNameList == "":
				roomNameList = roomNameList + _room.LookupParameter("Name").AsString()
			else:
				roomNameList = roomNameList + ", " + _room.LookupParameter("Name").AsString()
				
			if roomNumberList == "":
				roomNumberList = roomNumberList + _room.LookupParameter("Number").AsString()
			else:
				roomNumberList = roomNumberList + ", " + _room.LookupParameter("Number").AsString()
		
		if len(roomNameList)==0:
			roomNameList="X"
		if len(roomNumberList)==0:
			roomNumberList="X"
		outData[index] = [family,roomNameList,roomNumberList,roomList];#the output will be a 2D array : Element0 | List of Rooms
		#																									 Element1 | List of Rooms
		#outData[index].extend([FamiliesInRoom(room, families, doc),room])
except:
	# if error accurs anywhere in the process catch it
	import traceback
	errorReport = traceback.format_exc()

#Assign your output to the OUT variable
if errorReport == None:
	OUT = outData
else:
	OUT = errorReport
# ----------------------------------------
number = DoubleInput(1)
flatten = List.Flatten(list=python_script, amt=number)
number_2 = DoubleInput(4)
number_3 = DoubleInput(2)
takeEveryNthItem = List.TakeEveryNthItem(flatten, number_2, number_3)
RoomNames = Output(takeEveryNthItem)
watch = Watch(python_script)
number_4 = DoubleInput(1)
flatten_2 = List.Flatten(list=python_script, amt=number_4)
watch_2 = Watch(flatten)
number_5 = DoubleInput(1)
takeEveryNthItem_2 = List.TakeEveryNthItem(flatten, number_2, number_5)
watch_3 = Watch(takeEveryNthItem_2)
number_6 = DoubleInput(3)
takeEveryNthItem_3 = List.TakeEveryNthItem(flatten, number_2, number_6)
watch_4 = Watch(takeEveryNthItem_3)
Elements_2 = Output(takeEveryNthItem_2)  # "Elements"
RoomsNumbers = Output(takeEveryNthItem_3)
watch_5 = Watch(takeEveryNthItem)
takeEveryNthItem_4 = List.TakeEveryNthItem(flatten, number_2)
RoomList = Output(takeEveryNthItem_4)
watch_6 = Watch(takeEveryNthItem_4)
