# Dynamo graph LinkedRoomNN.dyn (Dynamo 1.2.1.3083)

categories = Categories("ElectricalEquipment")
all_elements_of_category = ElementsOfCategory(categories)
watch = Watch(all_elements_of_category)
get_documents = Custom[Get Documents]()  # Queries all linked Revit files and retrieves their Name, LinkInstance and Document properties.
number_slider = DoubleSlider(0, range=0..5 step 1)
getItemAtIndex = List.GetItemAtIndex(list=get_documents.Link_Doc, index=number_slider)
categories_2 = Categories("Rooms")
get_all_elements_from_linked = Custom[Get All Elements From Linked Model](LinkDoc=getItemAtIndex, Category=categories_2)  # This node is based on code posted by Julien Benoit. Big thanks to Julien for sharing his work. This node will retrieve all elements of a given category from a given linked model.
watch_2 = Watch(get_all_elements_from_linked)
categories_3 = Categories("CommunicationDevices")
all_elements_of_category_2 = ElementsOfCategory(categories_3)
join = List.Join(all_elements_of_category_2, all_elements_of_category)
elementsInWhichRooms = Custom[ElementsInWhichRooms](Elements=join, Rooms=get_all_elements_from_linked)  # This node will check if any of the supplied elements are inside any of the supplied rooms. It will return the list of elements, as well as equal length lists of room numbers, room names, or the rooms themselves.
watch_3 = Watch(elementsInWhichRooms.Elements)
code_block = CodeBlock { "Linked Room Number"; }
setParameterByName = Element.SetParameterByName(element=elementsInWhichRooms.Elements, parameterName=code_block, value=elementsInWhichRooms.RoomsNumbers)
watch_4 = Watch(setParameterByName)
watch_5 = Watch(get_documents.Link_Doc)
code_block_2 = CodeBlock { "Linked Room Name"; }
setParameterByName_2 = Element.SetParameterByName(element=elementsInWhichRooms.Elements, parameterName=code_block_2, value=elementsInWhichRooms.RoomNames)
watch_6 = Watch(setParameterByName_2)
watch_7 = Watch(elementsInWhichRooms.RoomNames)
watch_8 = Watch(elementsInWhichRooms.RoomList)
watch_9 = Watch(all_elements_of_category_2)
