# Dynamo custom node Create Column Pairs.dyf (Dynamo 0.6.3.7993)
# category: buildz

# note: Remove Diagonals X-Direction Beams

number = DoubleInput(0)
numcolumnsinx = Input()
numcolumnsiny = Input()
# note: # of Columns per Floor
formula = Formula("NumColumnsinX*NumColumnsinY", NumColumnsinX=numcolumnsinx, NumColumnsinY=numcolumnsiny, lacing=Longest)
numpointszdirection = Input()
# note: Number of Floors
formula_2 = Formula("NumPointsZDirection-1", NumPointsZDirection=numpointszdirection, lacing=Longest)
# note: Total # of Columns in Building
multiply = Multiplication(formula, formula_2, lacing=Longest)
number_2 = DoubleInput(1)
# note: Create Column 1st Point Pair List (Length = # of Columns)
number_sequence = NumberSeq(number, multiply, number_2, lacing=Longest)
# note: Create Column 2nd Point Pair List (Length = # of Columns but Offset by # of Columns per Floor
add = Addition(number_sequence, formula, lacing=Longest)
join_lists = Append(number_sequence, add)
watch = Watch(join_lists)
xyz_y = XyzGetY(lacing=Longest)
xyz_x = XyzGetX(lacing=Longest)
list = Input()
get_from_list = GetFromList(join_lists, list)
sort_by_key = SortBy(xyz_x, get_from_list)
sort_by_key_2 = SortBy(xyz_y, sort_by_key)
number_3 = DoubleInput(2)
build_sublists = Sublists("0..1", sort_by_key_2, number_3, lacing=Longest)
watch_2 = Watch(build_sublists)
list_2 = Output(build_sublists)  # "list"
