# Dynamo custom node wavesurface.dyf "surf" (Dynamo 0.8.0.1111)
# category: CN

code_block = CodeBlock { 0..10; }
code_block_2 = CodeBlock { 0; }
code_block_3 = CodeBlock { 1; }
integer_slider = IntegerSlider(36, range=0..37 step 1)
code_block_4 = CodeBlock(a=integer_slider) { 0..a*10..10; }
integer_slider_2 = IntegerSlider(3, range=0..7 step 1)
code_block_5 = CodeBlock { 360; }
code_block_6 = CodeBlock(A=code_block_3, w=code_block_4, t=integer_slider_2, phi=code_block_5) { A*Math.Sin(w*t+phi); }
byCoordinates = Point.ByCoordinates(x=code_block, y=code_block_2, z=code_block_6)
byControlPoints = NurbsCurve.ByControlPoints(byCoordinates)
code_block_7 = CodeBlock { 0..1..0.1; }
pointAtParameter = Curve.PointAtParameter(curve=byControlPoints, param=code_block_7)
code_block_8 = CodeBlock { 0..10; }
code_block_9 = CodeBlock { 10; }
code_block_10 = CodeBlock { 1; }
integer_slider_3 = IntegerSlider(36, range=0..37 step 1)
code_block_11 = CodeBlock(a=integer_slider_3) { 0..a*10..10; }
integer_slider_4 = IntegerSlider(7, range=0..7 step 1)
code_block_12 = CodeBlock { 360; }
code_block_13 = CodeBlock(A=code_block_10, w=code_block_11, t=integer_slider_4, phi=code_block_12) { A*Math.Cos(w*t+phi); }
byCoordinates_2 = Point.ByCoordinates(x=code_block_8, y=code_block_9, z=code_block_13)
byControlPoints_2 = NurbsCurve.ByControlPoints(byCoordinates_2)
create = List.Create(byControlPoints_2, byControlPoints)
byLoft = Surface.ByLoft(create)
Surface = Output(byLoft)
