# Dynamo custom node CreateCornerByTrimmingTwoSurface.dyf (Dynamo 0.7.4.3151)
# category: CustomNodes
# Pass two surface and pick point and you will get Trimmed Surface.

Surface2 = Input()
Surface1 = Input()
pickPoint = Input()
trim = Geometry.Trim(Surface2, Surface1, pickPoint)
trim_2 = Geometry.Trim(Surface1, Surface2, pickPoint)
create = List.Create(trim, trim_2)
flatten = Flatten(create)
finalSurface = Output(flatten)
