# Dynamo custom node Curve Pipe.dyf (Dynamo 0.8.0.950)
# category: Geometry.Solid
# Creates a solid pipe around a curve

Curve = Input()
code_block = CodeBlock { 0; }
planeAtParameter = Curve.PlaneAtParameter(curve=Curve, param=code_block)
Diameter = Input()
code_block_2 = CodeBlock(x=Diameter) { x/2; }
byPlaneRadius = Circle.ByPlaneRadius(plane=planeAtParameter, radius=code_block_2)
sweepAsSolid = Curve.SweepAsSolid(byPlaneRadius, Curve)
Pipe = Output(sweepAsSolid)
