# Dynamo custom node CURVE REVERSE.dyf (Dynamo 0.7.5.3566)
# category: Geometry.Curve.Actions
# REVERSES CURVE

test = Input()
curve = Input()
startPoint = Curve.StartPoint(curve)
endPoint = Curve.EndPoint(curve)
if_ = If(test, startPoint, endPoint)
curve_end_1 = Output(if_)
if_2 = If(test, endPoint, startPoint)
curve_2 = Output(if_2)
