# Dynamo custom node Corian pearlescent .dyf "Corian pearlescent" (Dynamo 0.7.5.3566)
# category: Geometry.Solid.Actions
# devides corian and pearlescent faces

Face = Input()
Half_pearlescent = Input()  # "Half pearlescent?"
Edge_corian_side = Input()
lowest_point = Custom[Lowest point](curve=Edge_corian_side)  # gest curve lower point
Edge_pearlescent_side = Input()
lowest_point_2 = Custom[Lowest point](curve=Edge_pearlescent_side)
byStartPointEndPoint = Line.ByStartPointEndPoint(lowest_point, lowest_point_2)
code_block = CodeBlock { 0.5; }
pointAtParameter = Curve.PointAtParameter(byStartPointEndPoint, code_block)
X = Point.X(lowest_point)
Y = Point.Y(lowest_point)
code_block_2 = CodeBlock { 4; }
byCoordinates = Point.ByCoordinates(X, Y, code_block_2)
byThreePoints = Plane.ByThreePoints(lowest_point, lowest_point_2, byCoordinates)
normal = Plane.Normal(byThreePoints)
code_block_3 = CodeBlock { 1; }
byStartPointDirectionLength = Line.ByStartPointDirectionLength(pointAtParameter, normal, code_block_3)
endPoint = Curve.EndPoint(byStartPointDirectionLength)
X_2 = Point.X(pointAtParameter)
Y_2 = Point.Y(pointAtParameter)
code_block_4 = CodeBlock { 4; }
byCoordinates_2 = Point.ByCoordinates(X_2, Y_2, code_block_4)
byThreePoints_2 = Plane.ByThreePoints(endPoint, pointAtParameter, byCoordinates_2)
highest_point = Custom[Highest point](curve=Edge_corian_side)  # gest curve lower point
byThreePoints_3 = Plane.ByThreePoints(highest_point, pointAtParameter, byCoordinates_2)
if_ = If(Half_pearlescent, byThreePoints_2, byThreePoints_3)
trim = Geometry.Trim(Face, if_, lowest_point_2)
Corian = Output(trim)
trim_2 = Geometry.Trim(Face, if_, lowest_point)
Pearlescent = Output(trim_2)
