# Dynamo custom node Corian pearlescent fatality.dyf (Dynamo 0.7.5.3566)
# category: Geometry.Solid.Actions
# corian pearlescent

Cote_corian_boolean = Input()  # "Cote corian? (boolean)"
Face = Input()
explode = Geometry.Explode(Face)
outside_surface = Custom[Outside surface](Solid_face=explode)  # Gets outside surface from solid face
perimeterCurves = Surface.PerimeterCurves(outside_surface)
XY = Plane.XY()
lowest_point = Custom[Lowest point](curve=perimeterCurves)  # gest curve lower point
trim = Geometry.Trim(perimeterCurves, XY, lowest_point)
flatten = Flatten(trim)
code_block = CodeBlock(c=perimeterCurves) { startpoint=c.StartPoint; endpoint=c.EndPoint; a=startpoint.Z; b=endpoint.Z; a==b?false:true; }
filterByBoolMask = List.FilterByBoolMask(flatten, code_block.out4)
code_block_2 = CodeBlock(x=filterByBoolMask) { x[1]; x[0]; }
if_ = If(Cote_corian_boolean, code_block_2.out0, code_block_2.out1)
if_2 = If(Cote_corian_boolean, code_block_2.out1, code_block_2.out0)
Half_pearlescent_boolean = Input()  # "Half pearlescent? (boolean)"
corian_pearlescent = Custom[Corian pearlescent](Edge_corian_side=if_, Edge_pearlescent_side=if_2, Face=Face, Half_pearlescent=Half_pearlescent_boolean)  # devides corian and pearlescent faces
flatten_2 = Flatten(corian_pearlescent.Corian)
Corian = Output(flatten_2)
flatten_3 = Flatten(corian_pearlescent.Pearlescent)
Pearlescent = Output(flatten_3)
