# Dynamo custom node Corian plaster Fatality.dyf (Dynamo 0.7.5.3566)
# category: Geometry.Solid.Actions
# corian plaster

Horizontal_boolean = Input()  # "Horizontal? (boolean)"
Sens_de_la_pente_boolean = Input()  # "Sens de la pente? (boolean)"
Face = Input()
explode = Geometry.Explode(Face)
outside_surface = Custom[Outside surface](Solid_face=explode)  # Gets outside surface from solid face
perimeterCurves = Surface.PerimeterCurves(outside_surface)
XY = Plane.XY()
lowest_point = Custom[Lowest point](curve=perimeterCurves)  # gest curve lower point
trim = Geometry.Trim(perimeterCurves, XY, lowest_point)
flatten = Flatten(trim)
startPoint = Curve.StartPoint(perimeterCurves)
endPoint = Curve.EndPoint(perimeterCurves)
code_block = CodeBlock(startpoint=startPoint, endpoint=endPoint) { a=startpoint.Z; b=endpoint.Z; a==b?false:true; }
filterByBoolMask = List.FilterByBoolMask(flatten, code_block.out2)
code_block_2 = CodeBlock(x=filterByBoolMask) { x[0]; x[1]; }
if_ = If(Sens_de_la_pente_boolean, code_block_2.out0, code_block_2.out1)
toNurbsCurve = Curve.ToNurbsCurve(if_)
code_block_3 = CodeBlock { 0; }
if_2 = If(Horizontal_boolean, toNurbsCurve, code_block_3)
if_3 = If(Sens_de_la_pente_boolean, code_block_2.out1, code_block_2.out0)
toNurbsCurve_2 = Curve.ToNurbsCurve(if_3)
if_4 = If(Horizontal_boolean, toNurbsCurve_2, code_block_3)
corian_plaster_horizontal = Custom[Corian plaster horizontal](Edge_1=if_2, Face=Face, Edge_2=if_4)  # separates materials in the horizontal case
if_5 = If(Horizontal_boolean, code_block_3, toNurbsCurve)
if_6 = If(Horizontal_boolean, code_block_3, toNurbsCurve_2)
division_corian_plaster = Custom[Division corian plaster](Edge_with_corian_high_point=if_5, Edge_with_corian_low_point=if_6, Face=Face)  # gives joint line between corian and plaster
if_7 = If(Horizontal_boolean, corian_plaster_horizontal.Plaster_solid_face, division_corian_plaster.Plaster_solid_face)
Plaster_solid_face = Output(if_7)
if_8 = If(Horizontal_boolean, corian_plaster_horizontal.Corian_solid_face, division_corian_plaster.Corian_Solid_face)
Corian_solid_face = Output(if_8)
