# Dynamo custom node Corian plaster horizontal .dyf "Corian plaster horizontal" (Dynamo 0.7.5.3566)
# category: Geometry.Solid.Create
# separates materials in the horizontal case

Face = Input()
code_block = CodeBlock { 1.5; }
xy_plane_at_height = Custom[XY plane at height](Height=code_block)  # gives a XY plane at a given height
Edge_2 = Input()
highest_point = Custom[Highest point](curve=Edge_2)  # gest curve lower point
trim = Geometry.Trim(Face, xy_plane_at_height, highest_point)
Corian_solid_face = Output(trim)
Edge_1 = Input()
lowest_point = Custom[Lowest point](curve=Edge_1)  # gest curve lower point
trim_2 = Geometry.Trim(Face, xy_plane_at_height, lowest_point)
Plaster_solid_face = Output(trim_2)
