# Dynamo custom node Crease 3D.dyf (Dynamo 0.7.5.3566)
# category: Geometry.Solid.Create
# creates creases en surface and gives triming tools

Outside_face = Input()
perimeterCurves = Surface.PerimeterCurves(Outside_face)
code_block = CodeBlock { 0; 2; }
getItemAtIndex = List.GetItemAtIndex(perimeterCurves, code_block.out0)
highest_point = Custom[Highest point](curve=getItemAtIndex)  # gest curve lower point
getItemAtIndex_2 = List.GetItemAtIndex(perimeterCurves, code_block.out1)
highest_point_2 = Custom[Highest point](curve=getItemAtIndex_2)
byStartPointEndPoint = Line.ByStartPointEndPoint(highest_point, highest_point_2)
Number_of_creases = Input()
code_block_2 = CodeBlock(n=Number_of_creases) { 0; 1; 1/(n+1); }
number_range = NumberRange(code_block_2.out0, code_block_2.out1, code_block_2.out2, lacing=Longest)
remove_first_last = Custom[Remove first last](list=number_range)  # removes first and last item of a list
code_block_3 = CodeBlock { 30; }
tan = Math.Tan(code_block_3)
length = Curve.Length(byStartPointEndPoint)
code_block_4 = CodeBlock(tan=tan, l=length) { (0.125/tan)/l; }
code_block_5 = CodeBlock(a=remove_first_last, b=code_block_4) { a-b; }
pointAtParameter = Curve.PointAtParameter(byStartPointEndPoint, code_block_5)
lowest_point = Custom[Lowest point](curve=getItemAtIndex)  # gest curve lower point
lowest_point_2 = Custom[Lowest point](curve=getItemAtIndex_2)
byStartPointEndPoint_2 = Line.ByStartPointEndPoint(lowest_point, lowest_point_2)
pointAtParameter_2 = Curve.PointAtParameter(byStartPointEndPoint_2, code_block_5)
X = Point.X(pointAtParameter_2)
Y = Point.Y(pointAtParameter_2)
code_block_6 = CodeBlock { 4; }
byCoordinates = Point.ByCoordinates(X, Y, code_block_6)
byThreePoints = Plane.ByThreePoints(pointAtParameter, pointAtParameter_2, byCoordinates)
intersect = Geometry.Intersect(byThreePoints, Outside_face)
flatten = Flatten(intersect)
code_block_7 = CodeBlock { 0.75; }
xy_plane_at_height = Custom[XY plane at height](Height=code_block_7)  # gives a XY plane at a given height
intersect_2 = Geometry.Intersect(flatten, xy_plane_at_height)
code_block_8 = CodeBlock(a=remove_first_last, b=code_block_4) { a+b; }
pointAtParameter_3 = Curve.PointAtParameter(byStartPointEndPoint, code_block_8)
pointAtParameter_4 = Curve.PointAtParameter(byStartPointEndPoint_2, code_block_8)
X_2 = Point.X(pointAtParameter_4)
Y_2 = Point.Y(pointAtParameter_4)
code_block_9 = CodeBlock { 4; }
byCoordinates_2 = Point.ByCoordinates(X_2, Y_2, code_block_9)
byThreePoints_2 = Plane.ByThreePoints(pointAtParameter_3, pointAtParameter_4, byCoordinates_2)
intersect_3 = Geometry.Intersect(byThreePoints_2, Outside_face)
flatten_2 = Flatten(intersect_3)
trim = Geometry.Trim(flatten_2, xy_plane_at_height, pointAtParameter_4)
flatten_3 = Flatten(trim)
pointAtParameter_5 = Curve.PointAtParameter(byStartPointEndPoint, remove_first_last)
pointAtParameter_6 = Curve.PointAtParameter(byStartPointEndPoint_2, remove_first_last)
X_3 = Point.X(pointAtParameter_6)
Y_3 = Point.Y(pointAtParameter_6)
code_block_10 = CodeBlock { 4; }
byCoordinates_3 = Point.ByCoordinates(X_3, Y_3, code_block_10)
byThreePoints_3 = Plane.ByThreePoints(pointAtParameter_5, pointAtParameter_6, byCoordinates_3)
intersect_4 = Geometry.Intersect(byThreePoints_3, Outside_face)
flatten_4 = Flatten(intersect_4)
trim_2 = Geometry.Trim(flatten_4, xy_plane_at_height, pointAtParameter_6)
flatten_5 = Flatten(trim_2)
length_2 = Curve.Length(flatten_5)
code_block_11 = CodeBlock(a=length_2) { 0; a/6; 2*(a/6); a/2; 4*(a/6); 5*(a/6); a; }
pointAtDistance = Curve.PointAtDistance(flatten_5, code_block_11.out0)
code_block_12 = CodeBlock { 0.5; }
normalAtParameter = Surface.NormalAtParameter(Outside_face, code_block_12, code_block_12)
Z = Vector.Z(normalAtParameter)
code_block_13 = CodeBlock(z=Z) { z>0; }
flipNormalDirection = Surface.FlipNormalDirection(Outside_face)
if_ = If(code_block_13, Outside_face, flipNormalDirection)
normalAtPoint = Surface.NormalAtPoint(if_, pointAtDistance)
code_block_14 = CodeBlock()
# ---------- code_block_14.designscript (6 lines) ----------
//control point translations

0;
0.02;
0.04;
0.05;
# ----------------------------------------
translate = Geometry.Translate(pointAtDistance, normalAtPoint, code_block_14.out0)
pointAtDistance_2 = Curve.PointAtDistance(flatten_5, code_block_11.out1)
normalAtPoint_2 = Surface.NormalAtPoint(if_, pointAtDistance_2)
translate_2 = Geometry.Translate(pointAtDistance_2, normalAtPoint_2, code_block_14.out1)
pointAtDistance_3 = Curve.PointAtDistance(flatten_5, code_block_11.out2)
normalAtPoint_3 = Surface.NormalAtPoint(if_, pointAtDistance_3)
translate_3 = Geometry.Translate(pointAtDistance_3, normalAtPoint_3, code_block_14.out2)
pointAtDistance_4 = Curve.PointAtDistance(flatten_5, code_block_11.out3)
normalAtPoint_4 = Surface.NormalAtPoint(if_, pointAtDistance_4)
translate_4 = Geometry.Translate(pointAtDistance_4, normalAtPoint_4, code_block_14.out3)
pointAtDistance_5 = Curve.PointAtDistance(flatten_5, code_block_11.out4)
normalAtPoint_5 = Surface.NormalAtPoint(if_, pointAtDistance_5)
translate_5 = Geometry.Translate(pointAtDistance_5, normalAtPoint_5, code_block_14.out2)
pointAtDistance_6 = Curve.PointAtDistance(flatten_5, code_block_11.out5)
normalAtPoint_6 = Surface.NormalAtPoint(if_, pointAtDistance_6)
translate_6 = Geometry.Translate(pointAtDistance_6, normalAtPoint_6, code_block_14.out1)
pointAtDistance_7 = Curve.PointAtDistance(flatten_5, code_block_11.a)
normalAtPoint_7 = Surface.NormalAtPoint(if_, pointAtDistance_7)
translate_7 = Geometry.Translate(pointAtDistance_7, normalAtPoint_7, code_block_14.out0)
create = List.Create(translate, translate_2, translate_3, translate_4, translate_5, translate_6, translate_7)
flatten_6 = Flatten(create)
code_block_15 = CodeBlock(n=Number_of_creases) { 1; n; 1; }
number_range_2 = NumberRange(code_block_15.out0, code_block_15.n, code_block_15.out2, lacing=Longest)
takeEveryNthItem = List.TakeEveryNthItem(flatten_6, Number_of_creases, number_range_2)
code_block_16 = CodeBlock { 2; }
byPoints = NurbsCurve.ByPoints(takeEveryNthItem, code_block_16)
create_2 = List.Create(flatten_3, byPoints)
flatten_7 = Flatten(create_2)
code_block_17 = CodeBlock(n=Number_of_creases) { 1; n; 1; }
number_range_3 = NumberRange(code_block_17.out0, code_block_17.n, code_block_17.out2, lacing=Longest)
takeEveryNthItem_2 = List.TakeEveryNthItem(flatten_7, Number_of_creases, number_range_3)
byLoft = Surface.ByLoft(takeEveryNthItem_2)
trim_3 = Geometry.Trim(flatten, xy_plane_at_height, pointAtParameter_6)
flatten_8 = Flatten(trim_3)
create_3 = List.Create(byPoints, flatten_8)
flatten_9 = Flatten(create_3)
takeEveryNthItem_3 = List.TakeEveryNthItem(flatten_9, Number_of_creases, number_range_3)
byLoft_2 = Surface.ByLoft(takeEveryNthItem_3)
flatten_10 = Flatten(trim)
length_3 = Curve.Length(flatten_10)
code_block_18 = CodeBlock(a=length_3) { 0; a/6; 2*(a/6); a/2; 4*(a/6); 5*(a/6); a; }
pointAtDistance_8 = Curve.PointAtDistance(flatten_10, code_block_18.out0)
normalAtPoint_8 = Surface.NormalAtPoint(if_, pointAtDistance_8)
Crease_width = Input()
code_block_19 = CodeBlock(e=Crease_width)
# ---------- code_block_19.designscript (6 lines) ----------
//control point translations

e;
e;
e;
e;
# ----------------------------------------
translate_8 = Geometry.Translate(pointAtDistance_8, normalAtPoint_8, code_block_19.out0)
pointAtDistance_9 = Curve.PointAtDistance(flatten_10, code_block_18.out1)
normalAtPoint_9 = Surface.NormalAtPoint(if_, pointAtDistance_9)
translate_9 = Geometry.Translate(pointAtDistance_9, normalAtPoint_9, code_block_19.out1)
pointAtDistance_10 = Curve.PointAtDistance(flatten_10, code_block_18.out2)
normalAtPoint_10 = Surface.NormalAtPoint(if_, pointAtDistance_10)
translate_10 = Geometry.Translate(pointAtDistance_10, normalAtPoint_10, code_block_19.out2)
pointAtDistance_11 = Curve.PointAtDistance(flatten_10, code_block_18.out3)
normalAtPoint_11 = Surface.NormalAtPoint(if_, pointAtDistance_11)
translate_11 = Geometry.Translate(pointAtDistance_11, normalAtPoint_11, code_block_19.out3)
pointAtDistance_12 = Curve.PointAtDistance(flatten_10, code_block_18.out4)
normalAtPoint_12 = Surface.NormalAtPoint(if_, pointAtDistance_12)
translate_12 = Geometry.Translate(pointAtDistance_12, normalAtPoint_12, code_block_19.out2)
pointAtDistance_13 = Curve.PointAtDistance(flatten_10, code_block_18.out5)
normalAtPoint_13 = Surface.NormalAtPoint(if_, pointAtDistance_13)
translate_13 = Geometry.Translate(pointAtDistance_13, normalAtPoint_13, code_block_19.out1)
pointAtDistance_14 = Curve.PointAtDistance(flatten_10, code_block_18.a)
normalAtPoint_14 = Surface.NormalAtPoint(if_, pointAtDistance_14)
translate_14 = Geometry.Translate(pointAtDistance_14, normalAtPoint_14, code_block_19.out0)
create_4 = List.Create(translate_8, translate_9, translate_10, translate_11, translate_12, translate_13, translate_14)
flatten_11 = Flatten(create_4)
code_block_20 = CodeBlock(n=Number_of_creases) { 1; n; 1; }
number_range_4 = NumberRange(code_block_20.out0, code_block_20.n, code_block_20.out2, lacing=Longest)
takeEveryNthItem_4 = List.TakeEveryNthItem(flatten_11, Number_of_creases, number_range_4)
code_block_21 = CodeBlock { 2; }
byPoints_2 = NurbsCurve.ByPoints(takeEveryNthItem_4, code_block_21)
create_5 = List.Create(byPoints_2, flatten_3)
flatten_12 = Flatten(create_5)
code_block_22 = CodeBlock(n=Number_of_creases) { 1; n; 1; }
number_range_5 = NumberRange(code_block_22.out0, code_block_22.n, code_block_22.out2, lacing=Longest)
takeEveryNthItem_5 = List.TakeEveryNthItem(flatten_12, Number_of_creases, number_range_5)
byLoft_3 = Surface.ByLoft(takeEveryNthItem_5)
flatten_13 = Flatten(trim_3)
length_4 = Curve.Length(flatten_13)
code_block_23 = CodeBlock(a=length_4) { 0; a/6; 2*(a/6); a/2; 4*(a/6); 5*(a/6); a; }
pointAtDistance_15 = Curve.PointAtDistance(flatten_13, code_block_23.out0)
normalAtPoint_15 = Surface.NormalAtPoint(if_, pointAtDistance_15)
code_block_24 = CodeBlock(e=Crease_width)  # same code as code_block_19
translate_15 = Geometry.Translate(pointAtDistance_15, normalAtPoint_15, code_block_24.out0)
pointAtDistance_16 = Curve.PointAtDistance(flatten_13, code_block_23.out1)
normalAtPoint_16 = Surface.NormalAtPoint(if_, pointAtDistance_16)
translate_16 = Geometry.Translate(pointAtDistance_16, normalAtPoint_16, code_block_24.out1)
pointAtDistance_17 = Curve.PointAtDistance(flatten_13, code_block_23.out2)
normalAtPoint_17 = Surface.NormalAtPoint(if_, pointAtDistance_17)
translate_17 = Geometry.Translate(pointAtDistance_17, normalAtPoint_17, code_block_24.out2)
pointAtDistance_18 = Curve.PointAtDistance(flatten_13, code_block_23.out3)
normalAtPoint_18 = Surface.NormalAtPoint(if_, pointAtDistance_18)
translate_18 = Geometry.Translate(pointAtDistance_18, normalAtPoint_18, code_block_24.out3)
pointAtDistance_19 = Curve.PointAtDistance(flatten_13, code_block_23.out4)
normalAtPoint_19 = Surface.NormalAtPoint(if_, pointAtDistance_19)
translate_19 = Geometry.Translate(pointAtDistance_19, normalAtPoint_19, code_block_24.out2)
pointAtDistance_20 = Curve.PointAtDistance(flatten_13, code_block_23.out5)
normalAtPoint_20 = Surface.NormalAtPoint(if_, pointAtDistance_20)
translate_20 = Geometry.Translate(pointAtDistance_20, normalAtPoint_20, code_block_24.out1)
pointAtDistance_21 = Curve.PointAtDistance(flatten_13, code_block_23.a)
normalAtPoint_21 = Surface.NormalAtPoint(if_, pointAtDistance_21)
translate_21 = Geometry.Translate(pointAtDistance_21, normalAtPoint_21, code_block_24.out0)
create_6 = List.Create(translate_15, translate_16, translate_17, translate_18, translate_19, translate_20, translate_21)
flatten_14 = Flatten(create_6)
code_block_25 = CodeBlock(n=Number_of_creases) { 1; n; 1; }
number_range_6 = NumberRange(code_block_25.out0, code_block_25.n, code_block_25.out2, lacing=Longest)
takeEveryNthItem_6 = List.TakeEveryNthItem(flatten_14, Number_of_creases, number_range_6)
code_block_26 = CodeBlock { 2; }
byPoints_3 = NurbsCurve.ByPoints(takeEveryNthItem_6, code_block_26)
create_7 = List.Create(flatten_8, byPoints_3)
flatten_15 = Flatten(create_7)
takeEveryNthItem_7 = List.TakeEveryNthItem(flatten_15, Number_of_creases, number_range_5)
byLoft_4 = Surface.ByLoft(takeEveryNthItem_7)
flatten_16 = Flatten(byPoints)
length_5 = Curve.Length(flatten_16)
code_block_27 = CodeBlock(a=length_5) { 0; a/6; 2*(a/6); a/2; 4*(a/6); 5*(a/6); a; }
pointAtDistance_22 = Curve.PointAtDistance(flatten_16, code_block_27.out0)
normalAtPoint_22 = Surface.NormalAtPoint(if_, pointAtDistance_22)
code_block_28 = CodeBlock(e=Crease_width)  # same code as code_block_19
translate_22 = Geometry.Translate(pointAtDistance_22, normalAtPoint_22, code_block_28.out0)
pointAtDistance_23 = Curve.PointAtDistance(flatten_16, code_block_27.out1)
normalAtPoint_23 = Surface.NormalAtPoint(if_, pointAtDistance_23)
translate_23 = Geometry.Translate(pointAtDistance_23, normalAtPoint_23, code_block_28.out1)
pointAtDistance_24 = Curve.PointAtDistance(flatten_16, code_block_27.out2)
normalAtPoint_24 = Surface.NormalAtPoint(if_, pointAtDistance_24)
translate_24 = Geometry.Translate(pointAtDistance_24, normalAtPoint_24, code_block_28.out2)
pointAtDistance_25 = Curve.PointAtDistance(flatten_16, code_block_27.out3)
normalAtPoint_25 = Surface.NormalAtPoint(if_, pointAtDistance_25)
translate_25 = Geometry.Translate(pointAtDistance_25, normalAtPoint_25, code_block_28.out3)
pointAtDistance_26 = Curve.PointAtDistance(flatten_16, code_block_27.out4)
normalAtPoint_26 = Surface.NormalAtPoint(if_, pointAtDistance_26)
translate_26 = Geometry.Translate(pointAtDistance_26, normalAtPoint_26, code_block_28.out2)
pointAtDistance_27 = Curve.PointAtDistance(flatten_16, code_block_27.out5)
normalAtPoint_27 = Surface.NormalAtPoint(if_, pointAtDistance_27)
translate_27 = Geometry.Translate(pointAtDistance_27, normalAtPoint_27, code_block_28.out1)
pointAtDistance_28 = Curve.PointAtDistance(flatten_16, code_block_27.a)
normalAtPoint_28 = Surface.NormalAtPoint(if_, pointAtDistance_28)
translate_28 = Geometry.Translate(pointAtDistance_28, normalAtPoint_28, code_block_28.out0)
create_8 = List.Create(translate_22, translate_23, translate_24, translate_25, translate_26, translate_27, translate_28)
flatten_17 = Flatten(create_8)
code_block_29 = CodeBlock(n=Number_of_creases) { 1; n; 1; }
number_range_7 = NumberRange(code_block_29.out0, code_block_29.n, code_block_29.out2, lacing=Longest)
takeEveryNthItem_8 = List.TakeEveryNthItem(flatten_17, Number_of_creases, number_range_7)
code_block_30 = CodeBlock { 2; }
byPoints_4 = NurbsCurve.ByPoints(takeEveryNthItem_8, code_block_30)
create_9 = List.Create(byPoints_4, byPoints_3)
flatten_18 = Flatten(create_9)
code_block_31 = CodeBlock(n=Number_of_creases) { 1; n; 1; }
number_range_8 = NumberRange(code_block_31.out0, code_block_31.n, code_block_31.out2, lacing=Longest)
takeEveryNthItem_9 = List.TakeEveryNthItem(flatten_18, Number_of_creases, number_range_8)
byLoft_5 = Surface.ByLoft(takeEveryNthItem_9)
create_10 = List.Create(byPoints_2, byPoints_4)
flatten_19 = Flatten(create_10)
takeEveryNthItem_10 = List.TakeEveryNthItem(flatten_19, Number_of_creases, number_range_8)
byLoft_6 = Surface.ByLoft(takeEveryNthItem_10)
highest_lowest_points = Custom[Highest.lowest points](curve=byPoints_2)  # gives curves highest and lowest points
flatten_20 = Flatten(highest_lowest_points.Highest)
highest_lowest_points_2 = Custom[Highest.lowest points](curve=byPoints_3)
flatten_21 = Flatten(highest_lowest_points_2.Highest)
byStartPointEndPoint_3 = Line.ByStartPointEndPoint(flatten_20, flatten_21)
highest_lowest_points_3 = Custom[Highest.lowest points](curve=flatten_3)
flatten_22 = Flatten(highest_lowest_points_3.Highest)
highest_lowest_points_4 = Custom[Highest.lowest points](curve=flatten_8)
flatten_23 = Flatten(highest_lowest_points_4.Highest)
byStartPointEndPoint_4 = Line.ByStartPointEndPoint(flatten_22, flatten_23)
create_11 = List.Create(byStartPointEndPoint_3, byStartPointEndPoint_4)
flatten_24 = Flatten(create_11)
takeEveryNthItem_11 = List.TakeEveryNthItem(flatten_24, Number_of_creases, number_range_8)
byLoft_7 = Surface.ByLoft(takeEveryNthItem_11)
flatten_25 = Flatten(highest_lowest_points.lowest)
flatten_26 = Flatten(highest_lowest_points_2.lowest)
byStartPointEndPoint_5 = Line.ByStartPointEndPoint(flatten_25, flatten_26)
flatten_27 = Flatten(highest_lowest_points_3.lowest)
flatten_28 = Flatten(highest_lowest_points_4.lowest)
byStartPointEndPoint_6 = Line.ByStartPointEndPoint(flatten_27, flatten_28)
create_12 = List.Create(byStartPointEndPoint_5, byStartPointEndPoint_6)
flatten_29 = Flatten(create_12)
takeEveryNthItem_12 = List.TakeEveryNthItem(flatten_29, Number_of_creases, number_range_8)
byLoft_8 = Surface.ByLoft(takeEveryNthItem_12)
create_13 = List.Create(byLoft, byLoft_2, byLoft_3, byLoft_4, byLoft_5, byLoft_6, byLoft_7, byLoft_8)
flatten_30 = Flatten(create_13)
byJoinedSurfaces = PolySurface.ByJoinedSurfaces(flatten_30)
extractSolids = PolySurface.ExtractSolids(byJoinedSurfaces)
creases = Output(extractSolids)
Plaster_solid_face = Input()
create_14 = List.Create(flatten_3, flatten_8)
flatten_31 = Flatten(create_14)
code_block_32 = CodeBlock(n=Number_of_creases) { 0; n-1; 1; }
number_range_9 = NumberRange(code_block_32.out0, code_block_32.out1, code_block_32.out2)
takeEveryNthItem_13 = List.TakeEveryNthItem(flatten_31, Number_of_creases, number_range_9)
byLoft_9 = Surface.ByLoft(takeEveryNthItem_13)
code_block_33 = CodeBlock { 0.1; }
code_block_34 = CodeBlock { 1; }
thicken = Surface.Thicken(byLoft_9, code_block_33, code_block_34)
differenceAll = Solid.DifferenceAll(Plaster_solid_face, thicken)
trimed_Plaster_surface = Output(differenceAll)
Corian_solid_face = Input()
differenceAll_2 = Solid.DifferenceAll(Corian_solid_face, thicken)
trimed_Corian_surface = Output(differenceAll_2)
