# Dynamo custom node Crease M2.dyf (Dynamo 0.7.5.3566)
# category: Geometry.Cuboid.Query
# Crease M2

element = Input()
geometry = Element.Geometry(element)
element_2 = Input(element)
geometry_2 = Element.Geometry(element_2)
create = List.Create(geometry, geometry_2)
flatten = Flatten(create)
byLoft = Surface.ByLoft(flatten)
code_block = CodeBlock { 0; }
n = Input()
code_block_2 = CodeBlock(n=n) { 1+n; }
code_block_3 = CodeBlock(n=code_block_2) { 0; 1; 1/n; }
number_range = NumberRange(code_block_3.out0, code_block_3.out1, code_block_3.out2, lacing=Longest)
code_block_4 = CodeBlock { 0; }
create_2 = List.Create(code_block_4, code_block_2)
removeItemAtIndex = List.RemoveItemAtIndex(number_range, create_2)
code_block_5 = CodeBlock { 30; }
sin = Math.Sin(code_block_5)
code_block_6 = CodeBlock(tan=sin) { 0.125/tan; }
controlPoints = NurbsCurve.ControlPoints(geometry)
flatten_2 = Flatten(controlPoints)
endPoint = Curve.EndPoint(geometry)
Z = Point.Z(endPoint)
code_block_7 = CodeBlock(z=Z) { z>1; }
code_block_8 = CodeBlock { 0; 4; }
if_ = If(code_block_7, code_block_8.out1, code_block_8.out0)
getItemAtIndex = List.GetItemAtIndex(flatten_2, if_)
controlPoints_2 = NurbsCurve.ControlPoints(geometry_2)
flatten_3 = Flatten(controlPoints_2)
endPoint_2 = Curve.EndPoint(geometry_2)
Z_2 = Point.Z(endPoint_2)
code_block_9 = CodeBlock(z=Z_2) { z>1; }
code_block_10 = CodeBlock { 0; 4; }
if_2 = If(code_block_9, code_block_10.out1, code_block_10.out0)
getItemAtIndex_2 = List.GetItemAtIndex(flatten_3, if_2)
byStartPointEndPoint = Line.ByStartPointEndPoint(getItemAtIndex, getItemAtIndex_2)
length = Curve.Length(byStartPointEndPoint)
code_block_11 = CodeBlock(x=code_block_6, l=length) { x/l; }
count = Count(removeItemAtIndex)
cycle = List.Cycle(code_block_11, count)
code_block_12 = CodeBlock(a=removeItemAtIndex, x=cycle) { a+x; a-x; }
byIsoCurveOnSurface = Curve.ByIsoCurveOnSurface(byLoft, code_block, code_block_12.out0)
XY = Plane.XY()
zTranslation = Input()
translate = Geometry.Translate(XY, arg3=zTranslation)
intersect = Geometry.Intersect(byIsoCurveOnSurface, translate)
byIsoCurveOnSurface_2 = Curve.ByIsoCurveOnSurface(byLoft, code_block, code_block_12.out1)
intersect_2 = Geometry.Intersect(byIsoCurveOnSurface_2, translate)
byStartPointEndPoint_2 = Line.ByStartPointEndPoint(intersect, intersect_2)
byIsoCurveOnSurface_3 = Curve.ByIsoCurveOnSurface(byLoft, code_block, removeItemAtIndex)
endPoint_3 = Curve.EndPoint(byIsoCurveOnSurface_3)
Z_3 = Point.Z(endPoint_3)
code_block_13 = CodeBlock(z=Z_3) { z>1; }
startPoint = Curve.StartPoint(byIsoCurveOnSurface_3)
if_3 = If(code_block_13, startPoint, endPoint_3)
byThreePoints = Plane.ByThreePoints(intersect, intersect_2, if_3)
normal = Plane.Normal(byThreePoints)
projectInputOnto = Surface.ProjectInputOnto(byLoft, byStartPointEndPoint_2, normal)
Geometry = Output(projectInputOnto)  # "Geometry[]"
X = Point.X(intersect)
Y = Point.Y(intersect)
byCoordinates = Point.ByCoordinates(X, Y)
endPoint_4 = Curve.EndPoint(byIsoCurveOnSurface)
Z_4 = Point.Z(endPoint_4)
code_block_14 = CodeBlock(z=Z_4) { z>1; }
startPoint_2 = Cone.StartPoint(byIsoCurveOnSurface)
if_4 = If(code_block_14, endPoint_4, startPoint_2)
code_block_15 = CodeBlock { 0; }
getItemAtIndex_3 = List.GetItemAtIndex(if_4, code_block_15)
flatten_4 = Flatten(getItemAtIndex_3)
code_block_16 = CodeBlock { 1; }
chop = List.Chop(flatten_4, code_block_16)
byThreePoints_2 = Plane.ByThreePoints(byCoordinates, intersect, chop)
intersect_3 = Geometry.Intersect(byLoft, byThreePoints_2)
flatten_5 = Flatten(intersect_3)
code_block_17 = CodeBlock { 1; }
chop_2 = List.Chop(flatten_5, code_block_17)
if_5 = If(code_block_14, startPoint_2, endPoint_4)
code_block_18 = CodeBlock { 0; }
getItemAtIndex_4 = List.GetItemAtIndex(if_5, code_block_18)
code_block_19 = CodeBlock { 1; }
chop_3 = List.Chop(getItemAtIndex_4, code_block_19)
trim = Geometry.Trim(chop_2, translate, chop_3)
Geometry_2 = Output(trim)  # "Geometry[]"
intersect_4 = Geometry.Intersect(byIsoCurveOnSurface_3, translate)
X_2 = Point.X(intersect_4)
Y_2 = Point.Y(intersect_4)
byCoordinates_2 = Point.ByCoordinates(X_2, Y_2)
if_6 = If(code_block_13, endPoint_3, startPoint)
code_block_20 = CodeBlock { 0; }
getItemAtIndex_5 = List.GetItemAtIndex(if_6, code_block_20)
flatten_6 = Flatten(getItemAtIndex_5)
code_block_21 = CodeBlock { 1; }
chop_4 = List.Chop(flatten_6, code_block_21)
byThreePoints_3 = Plane.ByThreePoints(byCoordinates_2, intersect_4, chop_4)
intersect_5 = Geometry.Intersect(byLoft, byThreePoints_3)
flatten_7 = Flatten(intersect_5)
code_block_22 = CodeBlock { 1; }
chop_5 = List.Chop(flatten_7, code_block_22)
code_block_23 = CodeBlock { 0; }
getItemAtIndex_6 = List.GetItemAtIndex(if_3, code_block_23)
code_block_24 = CodeBlock { 1; }
chop_6 = List.Chop(getItemAtIndex_6, code_block_24)
trim_2 = Geometry.Trim(chop_5, translate, chop_6)
Geometry_3 = Output(trim_2)  # "Geometry[]"
X_3 = Point.X(intersect_2)
Y_3 = Point.Y(intersect_2)
byCoordinates_3 = Point.ByCoordinates(X_3, Y_3)
endPoint_5 = Curve.EndPoint(byIsoCurveOnSurface_2)
Z_5 = Point.Z(endPoint_5)
code_block_25 = CodeBlock(z=Z_5) { z>1; }
startPoint_3 = Cone.StartPoint(byIsoCurveOnSurface_2)
if_7 = If(code_block_25, endPoint_5, startPoint_3)
code_block_26 = CodeBlock { 0; }
getItemAtIndex_7 = List.GetItemAtIndex(if_7, code_block_26)
flatten_8 = Flatten(getItemAtIndex_7)
code_block_27 = CodeBlock { 1; }
chop_7 = List.Chop(flatten_8, code_block_27)
byThreePoints_4 = Plane.ByThreePoints(byCoordinates_3, intersect_2, chop_7)
intersect_6 = Geometry.Intersect(byLoft, byThreePoints_4)
flatten_9 = Flatten(intersect_6)
code_block_28 = CodeBlock { 1; }
chop_8 = List.Chop(flatten_9, code_block_28)
if_8 = If(code_block_25, startPoint_3, endPoint_5)
code_block_29 = CodeBlock { 0; }
getItemAtIndex_8 = List.GetItemAtIndex(if_8, code_block_29)
code_block_30 = CodeBlock { 1; }
chop_9 = List.Chop(getItemAtIndex_8, code_block_30)
trim_3 = Geometry.Trim(chop_8, translate, chop_9)
Geometry_4 = Output(trim_3)  # "Geometry[]"
