# Dynamo custom node Crease final.dyf (Dynamo 0.7.5.3566)
# category: Geometry.Solid.Create
# gives creases on surface

Full_face = Input()
outside_surface = Custom[Outside surface](Solid_face=Full_face)  # Gets outside surface from solid face
outside_surface_2 = Custom[Outside surface](Solid_face=Full_face)
vertical_edges = Custom[Vertical edges](surface=outside_surface_2)  # gives a surface's vertical edges
highest_point = Custom[Highest point](curve=vertical_edges.Edge_1)  # gest curve lower point
highest_point_2 = Custom[Highest point](curve=vertical_edges.Edge_2)
line_lenth = Custom[Line + lenth](startPoint=highest_point, endPoint=highest_point_2)  # Line ans length output
number_of_creases = Input()
code_block = CodeBlock(n=number_of_creases) { 0; 1; 1/(n+1); }
number_range = NumberRange(code_block.out0, code_block.out1, code_block.out2, lacing=Longest)
remove_first_last = Custom[Remove first last](list=number_range)  # removes first and last item of a list
pointAtParameter = Curve.PointAtParameter(line_lenth.Line, remove_first_last)
lowest_point = Custom[Lowest point](curve=vertical_edges.Edge_1)  # gest curve lower point
lowest_point_2 = Custom[Lowest point](curve=vertical_edges.Edge_2)
line_lenth_2 = Custom[Line + lenth](startPoint=lowest_point, endPoint=lowest_point_2)
pointAtParameter_2 = Curve.PointAtParameter(line_lenth_2.Line, remove_first_last)
X = Point.X(pointAtParameter_2)
Y = Point.Y(pointAtParameter_2)
code_block_2 = CodeBlock { 10; }
byCoordinates = Point.ByCoordinates(X, Y, code_block_2)
byThreePoints = Plane.ByThreePoints(pointAtParameter, pointAtParameter_2, byCoordinates)
intersect = Geometry.Intersect(byThreePoints, outside_surface_2)
flatten = Flatten(intersect)
crease_start_Height = Input()
xy_plane_at_height = Custom[XY plane at height](Height=crease_start_Height)  # gives a XY plane at a given height
trim = Geometry.Trim(flatten, xy_plane_at_height, pointAtParameter_2)
flatten_2 = Flatten(trim)
code_block_3 = CodeBlock { 0; 1; 1/5; }
number_range_2 = NumberRange(code_block_3.out0, code_block_3.out1, code_block_3.out2, lacing=Longest)
pointAtParameter_3 = Curve.PointAtParameter(flatten_2, number_range_2, lacing=CrossProduct)
code_block_4 = CodeBlock { 0.5; }
normalAtParameter = Surface.NormalAtParameter(outside_surface_2, code_block_4, code_block_4)
Z = Vector.Z(normalAtParameter)
code_block_5 = CodeBlock(z=Z) { z>0; }
normalAtPoint = Surface.NormalAtPoint(outside_surface_2, pointAtParameter_3)
reverse = Vector.Reverse(normalAtPoint)
if_ = If(code_block_5, normalAtPoint, reverse)
code_block_6 = CodeBlock { 0; 0.015; 0.03; }
create = List.Create(code_block_6.out0, code_block_6.out1, code_block_6.out2, code_block_6.out2, code_block_6.out1, code_block_6.out0)
ofRepeatedItem = List.OfRepeatedItem(create, number_of_creases)
translate = Geometry.Translate(pointAtParameter_3, if_, ofRepeatedItem)
byPoints = NurbsCurve.ByPoints(translate)
startPoint = Curve.StartPoint(byPoints)
code_block_7 = CodeBlock { 0; }
getItemAtIndex = List.GetItemAtIndex(startPoint, code_block_7)
Z_2 = Point.Z(getItemAtIndex)
endPoint = Curve.EndPoint(byPoints)
getItemAtIndex_2 = List.GetItemAtIndex(endPoint, code_block_7)
Z_3 = Point.Z(getItemAtIndex_2)
code_block_8 = CodeBlock(a=Z_2, b=Z_3) { a>b; }
if_2 = If(code_block_8, startPoint, endPoint)
inside_surface = Custom[Inside surface](Solid_face=Full_face)  # Gets outside surface from solid face
vertical_edges_2 = Custom[Vertical edges](surface=inside_surface)
highest_point_3 = Custom[Highest point](curve=vertical_edges_2.Edge_1)
highest_point_4 = Custom[Highest point](curve=vertical_edges_2.Edge_2)
line_lenth_3 = Custom[Line + lenth](startPoint=highest_point_3, endPoint=highest_point_4)
code_block_9 = CodeBlock(n=number_of_creases) { 0; 1; 1/(n+1); }
number_range_3 = NumberRange(code_block_9.out0, code_block_9.out1, code_block_9.out2, lacing=Longest)
remove_first_last_2 = Custom[Remove first last](list=number_range_3)
pointAtParameter_4 = Curve.PointAtParameter(line_lenth_3.Line, remove_first_last_2)
lowest_point_3 = Custom[Lowest point](curve=vertical_edges_2.Edge_1)
lowest_point_4 = Custom[Lowest point](curve=vertical_edges_2.Edge_2)
line_lenth_4 = Custom[Line + lenth](startPoint=lowest_point_3, endPoint=lowest_point_4)
pointAtParameter_5 = Curve.PointAtParameter(line_lenth_4.Line, remove_first_last_2)
X_2 = Point.X(pointAtParameter_5)
Y_2 = Point.Y(pointAtParameter_5)
code_block_10 = CodeBlock { 10; }
byCoordinates_2 = Point.ByCoordinates(X_2, Y_2, code_block_10)
byThreePoints_2 = Plane.ByThreePoints(pointAtParameter_4, pointAtParameter_5, byCoordinates_2)
intersect_2 = Geometry.Intersect(byThreePoints_2, inside_surface)
flatten_3 = Flatten(intersect_2)
xy_plane_at_height_2 = Custom[XY plane at height](Height=crease_start_Height)
trim_2 = Geometry.Trim(flatten_3, xy_plane_at_height_2, pointAtParameter_5)
flatten_4 = Flatten(trim_2)
code_block_11 = CodeBlock { 0; 1; 1/5; }
number_range_4 = NumberRange(code_block_11.out0, code_block_11.out1, code_block_11.out2, lacing=Longest)
pointAtParameter_6 = Curve.PointAtParameter(flatten_4, number_range_4, lacing=CrossProduct)
code_block_12 = CodeBlock { 0.5; }
normalAtParameter_2 = Surface.NormalAtParameter(inside_surface, code_block_12, code_block_12)
Z_4 = Vector.Z(normalAtParameter_2)
code_block_13 = CodeBlock(z=Z_4) { z>0; }
normalAtPoint_2 = Surface.NormalAtPoint(inside_surface, pointAtParameter_6)
reverse_2 = Vector.Reverse(normalAtPoint_2)
if_3 = If(code_block_13, normalAtPoint_2, reverse_2)
code_block_14 = CodeBlock { 0; 0.015; 0.03; }
create_2 = List.Create(code_block_14.out0, code_block_14.out1, code_block_14.out2, code_block_14.out2, code_block_14.out1, code_block_14.out0)
ofRepeatedItem_2 = List.OfRepeatedItem(create_2, number_of_creases)
translate_2 = Geometry.Translate(pointAtParameter_6, if_3, ofRepeatedItem_2)
byPoints_2 = NurbsCurve.ByPoints(translate_2)
startPoint_2 = Curve.StartPoint(byPoints_2)
code_block_15 = CodeBlock { 0; }
getItemAtIndex_3 = List.GetItemAtIndex(startPoint_2, code_block_15)
Z_5 = Point.Z(getItemAtIndex_3)
endPoint_2 = Curve.EndPoint(byPoints_2)
getItemAtIndex_4 = List.GetItemAtIndex(endPoint_2, code_block_15)
Z_6 = Point.Z(getItemAtIndex_4)
code_block_16 = CodeBlock(a=Z_5, b=Z_6) { a>b; }
if_4 = If(code_block_16, startPoint_2, endPoint_2)
byStartPointEndPoint = Line.ByStartPointEndPoint(if_2, if_4)
if_5 = If(code_block_8, endPoint, startPoint)
if_6 = If(code_block_16, endPoint_2, startPoint_2)
byStartPointEndPoint_2 = Line.ByStartPointEndPoint(if_5, if_6)
create_3 = List.Create(byPoints, byStartPointEndPoint, byPoints_2, byStartPointEndPoint_2)
flatten_5 = Flatten(create_3)
code_block_17 = CodeBlock(n=number_of_creases) { 1; n; 1; }
number_range_5 = NumberRange(code_block_17.out2, code_block_17.n, code_block_17.out0, lacing=Longest)
takeEveryNthItem = List.TakeEveryNthItem(flatten_5, number_of_creases, number_range_5)
byJoinedCurves = PolyCurve.ByJoinedCurves(takeEveryNthItem)
code_block_18 = CodeBlock { 30; }
tan = Math.Tan(code_block_18)
code_block_19 = CodeBlock(r=remove_first_last, tan=tan, l=line_lenth.Length) { r+(0.125/tan)/l; r-(0.125/tan)/l; }
pointAtParameter_7 = Curve.PointAtParameter(line_lenth.Line, code_block_19.out0)
pointAtParameter_8 = Curve.PointAtParameter(line_lenth_2.Line, code_block_19.out0)
X_3 = Point.X(pointAtParameter_8)
Y_3 = Point.Y(pointAtParameter_8)
byCoordinates_3 = Point.ByCoordinates(X_3, Y_3, code_block_2)
byThreePoints_3 = Plane.ByThreePoints(pointAtParameter_7, pointAtParameter_8, byCoordinates_3)
intersect_3 = Geometry.Intersect(byThreePoints_3, outside_surface_2)
flatten_6 = Flatten(intersect_3)
trim_3 = Geometry.Trim(flatten_6, xy_plane_at_height, pointAtParameter_8)
startPoint_3 = Curve.StartPoint(trim_3)
code_block_20 = CodeBlock { 0; }
getItemAtIndex_5 = List.GetItemAtIndex(startPoint_3, code_block_20)
Z_7 = Point.Z(getItemAtIndex_5)
endPoint_3 = Curve.EndPoint(trim_3)
getItemAtIndex_6 = List.GetItemAtIndex(endPoint_3, code_block_20)
Z_8 = Point.Z(getItemAtIndex_6)
code_block_21 = CodeBlock(a=Z_7, b=Z_8) { a>b; }
if_7 = If(code_block_21, startPoint_3, endPoint_3)
code_block_22 = CodeBlock { 30; }
tan_2 = Math.Tan(code_block_22)
code_block_23 = CodeBlock(r=remove_first_last_2, tan=tan_2, l=line_lenth_3.Length) { r+(0.125/tan)/l; r-(0.125/tan)/l; }
pointAtParameter_9 = Curve.PointAtParameter(line_lenth_3.Line, code_block_23.out0)
pointAtParameter_10 = Curve.PointAtParameter(line_lenth_4.Line, code_block_23.out0)
X_4 = Point.X(pointAtParameter_10)
Y_4 = Point.Y(pointAtParameter_10)
byCoordinates_4 = Point.ByCoordinates(X_4, Y_4, code_block_10)
byThreePoints_4 = Plane.ByThreePoints(pointAtParameter_9, pointAtParameter_10, byCoordinates_4)
intersect_4 = Geometry.Intersect(byThreePoints_4, inside_surface)
flatten_7 = Flatten(intersect_4)
trim_4 = Geometry.Trim(flatten_7, xy_plane_at_height_2, pointAtParameter_10)
startPoint_4 = Curve.StartPoint(trim_4)
code_block_24 = CodeBlock { 0; }
getItemAtIndex_7 = List.GetItemAtIndex(startPoint_4, code_block_24)
Z_9 = Point.Z(getItemAtIndex_7)
endPoint_4 = Curve.EndPoint(trim_4)
getItemAtIndex_8 = List.GetItemAtIndex(endPoint_4, code_block_24)
Z_10 = Point.Z(getItemAtIndex_8)
code_block_25 = CodeBlock(a=Z_9, b=Z_10) { a>b; }
if_8 = If(code_block_25, startPoint_4, endPoint_4)
byStartPointEndPoint_3 = Line.ByStartPointEndPoint(if_7, if_8)
if_9 = If(code_block_21, endPoint_3, startPoint_3)
if_10 = If(code_block_25, endPoint_4, startPoint_4)
byStartPointEndPoint_4 = Line.ByStartPointEndPoint(if_9, if_10)
create_4 = List.Create(byStartPointEndPoint_3, trim_3, byStartPointEndPoint_4, trim_4)
flatten_8 = Flatten(create_4)
takeEveryNthItem_2 = List.TakeEveryNthItem(flatten_8, number_of_creases, number_range_5)
byJoinedCurves_2 = PolyCurve.ByJoinedCurves(takeEveryNthItem_2)
create_5 = List.Create(byJoinedCurves, byJoinedCurves_2)
flatten_9 = Flatten(create_5)
takeEveryNthItem_3 = List.TakeEveryNthItem(flatten_9, number_of_creases, number_range_5)
byLoft = Solid.ByLoft(takeEveryNthItem_3)
pointAtParameter_11 = Curve.PointAtParameter(line_lenth.Line, code_block_19.out1)
pointAtParameter_12 = Curve.PointAtParameter(line_lenth_2.Line, code_block_19.out1)
X_5 = Point.X(pointAtParameter_12)
Y_5 = Point.Y(pointAtParameter_12)
byCoordinates_5 = Point.ByCoordinates(X_5, Y_5, code_block_2)
byThreePoints_5 = Plane.ByThreePoints(pointAtParameter_11, pointAtParameter_12, byCoordinates_5)
intersect_5 = Geometry.Intersect(byThreePoints_5, outside_surface_2)
flatten_10 = Flatten(intersect_5)
trim_5 = Geometry.Trim(flatten_10, xy_plane_at_height, pointAtParameter_12)
startPoint_5 = Curve.StartPoint(trim_5)
code_block_26 = CodeBlock { 0; }
getItemAtIndex_9 = List.GetItemAtIndex(startPoint_5, code_block_26)
Z_11 = Point.Z(getItemAtIndex_9)
endPoint_5 = Curve.EndPoint(trim_5)
getItemAtIndex_10 = List.GetItemAtIndex(endPoint_5, code_block_26)
Z_12 = Point.Z(getItemAtIndex_10)
code_block_27 = CodeBlock(a=Z_11, b=Z_12) { a>b; }
if_11 = If(code_block_27, startPoint_5, endPoint_5)
pointAtParameter_13 = Curve.PointAtParameter(line_lenth_3.Line, code_block_23.out1)
pointAtParameter_14 = Curve.PointAtParameter(line_lenth_4.Line, code_block_23.out1)
X_6 = Point.X(pointAtParameter_14)
Y_6 = Point.Y(pointAtParameter_14)
byCoordinates_6 = Point.ByCoordinates(X_6, Y_6, code_block_10)
byThreePoints_6 = Plane.ByThreePoints(pointAtParameter_13, pointAtParameter_14, byCoordinates_6)
intersect_6 = Geometry.Intersect(byThreePoints_6, inside_surface)
flatten_11 = Flatten(intersect_6)
trim_6 = Geometry.Trim(flatten_11, xy_plane_at_height_2, pointAtParameter_14)
startPoint_6 = Curve.StartPoint(trim_6)
code_block_28 = CodeBlock { 0; }
getItemAtIndex_11 = List.GetItemAtIndex(startPoint_6, code_block_28)
Z_13 = Point.Z(getItemAtIndex_11)
endPoint_6 = Curve.EndPoint(trim_6)
getItemAtIndex_12 = List.GetItemAtIndex(endPoint_6, code_block_28)
Z_14 = Point.Z(getItemAtIndex_12)
code_block_29 = CodeBlock(a=Z_13, b=Z_14) { a>b; }
if_12 = If(code_block_29, startPoint_6, endPoint_6)
byStartPointEndPoint_5 = Line.ByStartPointEndPoint(if_11, if_12)
if_13 = If(code_block_27, endPoint_5, startPoint_5)
if_14 = If(code_block_29, endPoint_6, startPoint_6)
byStartPointEndPoint_6 = Line.ByStartPointEndPoint(if_13, if_14)
create_6 = List.Create(trim_5, byStartPointEndPoint_5, trim_6, byStartPointEndPoint_6)
flatten_12 = Flatten(create_6)
takeEveryNthItem_4 = List.TakeEveryNthItem(flatten_12, number_of_creases, number_range_5)
byJoinedCurves_3 = PolyCurve.ByJoinedCurves(takeEveryNthItem_4)
create_7 = List.Create(byJoinedCurves, byJoinedCurves_3)
flatten_13 = Flatten(create_7)
takeEveryNthItem_5 = List.TakeEveryNthItem(flatten_13, number_of_creases, number_range_5)
byLoft_2 = Solid.ByLoft(takeEveryNthItem_5)
create_8 = List.Create(byLoft, byLoft_2)
flatten_14 = Flatten(create_8)
creases = Output(flatten_14)
plaster_face = Input()
create_9 = List.Create(trim_3, trim_5)
flatten_15 = Flatten(create_9)
code_block_30 = CodeBlock(n=number_of_creases) { 1; n; }
number_range_6 = NumberRange(code_block_30.out0, code_block_30.n, code_block_30.out0, lacing=Longest)
takeEveryNthItem_6 = List.TakeEveryNthItem(flatten_15, number_of_creases, number_range_6)
byLoft_3 = Surface.ByLoft(takeEveryNthItem_6)
code_block_31 = CodeBlock { 0.1; }
code_block_32 = CodeBlock { 1; }
thicken = Surface.Thicken(byLoft_3, code_block_31, code_block_32)
differenceAll = Solid.DifferenceAll(plaster_face, thicken)
trimmed_plaster_face = Output(differenceAll)
corian_face = Input()
differenceAll_2 = Solid.DifferenceAll(corian_face, thicken)
trimmer_corian_face = Output(differenceAll_2)
