# Dynamo custom node Division corian plaster.dyf (Dynamo 0.7.5.3566)
# category: Geometry.Solid.Actions
# gives joint line between corian and plaster

Face = Input()
code_block = CodeBlock { 1.5; }
xy_plane_at_height = Custom[XY plane at height](Height=code_block)  # gives a XY plane at a given height
Edge_with_corian_low_point = Input()
intersect = Geometry.Intersect(xy_plane_at_height, Edge_with_corian_low_point)
Edge_with_corian_high_point = Input()
create = List.Create(Edge_with_corian_high_point, Edge_with_corian_low_point)
flatten = Flatten(create)
byLoft = Surface.ByLoft(flatten)
normalAtPoint = Surface.NormalAtPoint(byLoft, intersect)
code_block_2 = CodeBlock { 1; }
byStartPointDirectionLength = Line.ByStartPointDirectionLength(intersect, normalAtPoint, code_block_2)
flatten_2 = Flatten(byStartPointDirectionLength)
controlPoints = NurbsCurve.ControlPoints(Edge_with_corian_high_point)
flatten_3 = Flatten(controlPoints)
code_block_3 = CodeBlock { 1; 2; 3; 0; 4; }
getItemAtIndex = List.GetItemAtIndex(flatten_3, code_block_3.out0)
getItemAtIndex_2 = List.GetItemAtIndex(flatten_3, code_block_3.out1)
byStartPointEndPoint = Line.ByStartPointEndPoint(getItemAtIndex, getItemAtIndex_2)
code_block_4 = CodeBlock { 0.5; }
pointAtParameter = Curve.PointAtParameter(byStartPointEndPoint, code_block_4)
getItemAtIndex_3 = List.GetItemAtIndex(flatten_3, code_block_3.out2)
byStartPointEndPoint_2 = Line.ByStartPointEndPoint(getItemAtIndex_2, getItemAtIndex_3)
pointAtParameter_2 = Curve.PointAtParameter(byStartPointEndPoint_2, code_block_4)
byStartPointEndPoint_3 = Line.ByStartPointEndPoint(pointAtParameter, pointAtParameter_2)
closestPointTo = Geometry.ClosestPointTo(byStartPointEndPoint_3, Edge_with_corian_high_point)
byLineAndPoint = Plane.ByLineAndPoint(flatten_2, closestPointTo)
flatten_4 = Flatten(byLineAndPoint)
intersect_2 = Geometry.Intersect(Face, flatten_4)
flatten_5 = Flatten(intersect_2)
perimeterCurves = Surface.PerimeterCurves(flatten_5)
flatten_6 = Flatten(perimeterCurves)
count = Count(flatten_6)
code_block_5 = CodeBlock(a=count) { a>=5; }
code_block_6 = CodeBlock { 2; 0; 1; }
getItemAtIndex_4 = List.GetItemAtIndex(perimeterCurves, code_block_6.out1)
startPoint = Curve.StartPoint(getItemAtIndex_4)
Z = Point.Z(startPoint)
sort = List.Sort(Z)
firstItem = List.FirstItem(sort)
getItemAtIndex_5 = List.GetItemAtIndex(perimeterCurves, code_block_6.out2)
startPoint_2 = Curve.StartPoint(getItemAtIndex_5)
Z_2 = Point.Z(startPoint_2)
sort_2 = List.Sort(Z_2)
firstItem_2 = List.FirstItem(sort_2)
code_block_7 = CodeBlock(a=firstItem, b=firstItem_2) { a<b; }
if_ = If(code_block_7, code_block_6.out1, code_block_6.out2)
code_block_8 = CodeBlock { 0; }
if_2 = If(code_block_5, if_, code_block_8)
getItemAtIndex_6 = List.GetItemAtIndex(flatten_5, if_2)
getItemAtIndex_7 = List.GetItemAtIndex(flatten_3, code_block_3.out3)
trim = Geometry.Trim(Face, getItemAtIndex_6, getItemAtIndex_7)
flatten_7 = Flatten(trim)
explode = Geometry.Explode(flatten_7)
flatten_8 = Flatten(explode)
perimeterCurves_2 = Surface.PerimeterCurves(flatten_8)
highest_lowest_points = Custom[Highest.lowest points](curve=perimeterCurves_2)  # gives curves highest and lowest points
flatten_9 = Flatten(highest_lowest_points.Highest)
Z_3 = Point.Z(flatten_9)
code_block_9 = CodeBlock { 0; }
sortIndexByValue = SortIndexByValue(Z_3, code_block_9)
getItemAtIndex_8 = List.GetItemAtIndex(flatten_9, sortIndexByValue)
code_block_10 = CodeBlock { 0; }
getItemAtIndex_9 = List.GetItemAtIndex(getItemAtIndex_8, code_block_10)
Z_4 = Point.Z(getItemAtIndex_9)
getItemAtIndex_10 = List.GetItemAtIndex(flatten_3, code_block_3.out4)
trim_2 = Geometry.Trim(Face, getItemAtIndex_6, getItemAtIndex_10)
flatten_10 = Flatten(trim_2)
explode_2 = Geometry.Explode(flatten_10)
flatten_11 = Flatten(explode_2)
perimeterCurves_3 = Surface.PerimeterCurves(flatten_11)
highest_lowest_points_2 = Custom[Highest.lowest points](curve=perimeterCurves_3)
flatten_12 = Flatten(highest_lowest_points_2.Highest)
Z_5 = Point.Z(flatten_12)
code_block_11 = CodeBlock { 0; }
sortIndexByValue_2 = SortIndexByValue(Z_5, code_block_11)
getItemAtIndex_11 = List.GetItemAtIndex(flatten_12, sortIndexByValue_2)
code_block_12 = CodeBlock { 0; }
getItemAtIndex_12 = List.GetItemAtIndex(getItemAtIndex_11, code_block_12)
Z_6 = Point.Z(getItemAtIndex_12)
code_block_13 = CodeBlock(a=Z_4, b=Z_6) { a>b; }
if_3 = If(code_block_13, flatten_7, flatten_10)
Plaster_solid_face = Output(if_3)
if_4 = If(code_block_13, flatten_10, flatten_7)
Corian_Solid_face = Output(if_4)
