# Dynamo custom node Downlight Legal intersection.dyf (Dynamo 0.7.5.3566)
# category: Geometry.Curve.Actions
# allows structure to deploy

intersection_curve = Input()
highest_lowest_points = Custom[Highest.lowest points](curve=intersection_curve)  # gives curves highest and lowest points
flatten = Flatten(highest_lowest_points.lowest)
X = Point.X(flatten)
Y = Point.Y(flatten)
Z = Point.Z(flatten)
flatten_2 = Flatten(highest_lowest_points.Highest)
Z_2 = Point.Z(flatten_2)
code_block = CodeBlock(a=Z_2, b=Z) { a-b; }
code_block_2 = CodeBlock(z=Z, Z=code_block) { z+0.4*Z; z+0.9*Z; }
byCoordinates = Point.ByCoordinates(X, Y, code_block_2.out0)
byCoordinates_2 = Point.ByCoordinates(X, Y, code_block_2.out1)
X_2 = Point.X(flatten_2)
Y_2 = Point.Y(flatten_2)
byCoordinates_3 = Point.ByCoordinates(X_2, Y_2, code_block_2.out1)
byStartPointEndPoint = Line.ByStartPointEndPoint(byCoordinates_2, byCoordinates_3)
code_block_3 = CodeBlock(Z=code_block) { 1.4*Z; 0.2*Z; }
pointAtDistance = Curve.PointAtDistance(byStartPointEndPoint, code_block_3.out0)
byStartPointEndPoint_2 = Line.ByStartPointEndPoint(flatten_2, pointAtDistance)
pointAtDistance_2 = Curve.PointAtDistance(byStartPointEndPoint_2, code_block_3.out1)
create = List.Create(flatten, byCoordinates, pointAtDistance, pointAtDistance_2, flatten_2)
flatten_3 = Flatten(create)
byControlPoints = NurbsCurve.ByControlPoints(flatten_3)
legal_curve = Output(byControlPoints)
