# Dynamo custom node Downlight Ref curves 5 apex.dyf (Dynamo 0.7.5.3566)
# category: Geometry.Curve.Create
# Downlight Ref curves 4 apex

curve_4 = Input()
startPoint = Curve.StartPoint(curve_4)
X = Point.X(startPoint)
Y = Point.Y(startPoint)
byCoordinates = Point.ByCoordinates(X, Y)
endPoint = Curve.EndPoint(curve_4)
X_2 = Point.X(endPoint)
Y_2 = Point.Y(endPoint)
byCoordinates_2 = Point.ByCoordinates(X_2, Y_2)
byStartPointEndPoint = Line.ByStartPointEndPoint(byCoordinates, byCoordinates_2)
Switch_4 = Input()
code_block = CodeBlock()
# ---------- code_block.designscript (6 lines) ----------
//hauteur downlight
0.5;

//epaisseur downlight

0.03;
# ----------------------------------------
downlight_spline = Custom[downlight spline](curve=byStartPointEndPoint, test=Switch_4, h=code_block.out0)  # spline from 2d guideline
code_block_2 = CodeBlock(h=code_block.out0) { -h; }
translate = Geometry.Translate(downlight_spline, arg3=code_block_2)
NurbsCurve = Output(translate)
curve_2 = Input()
startPoint_2 = Curve.StartPoint(curve_2)
X_3 = Point.X(startPoint_2)
Y_3 = Point.Y(startPoint_2)
byCoordinates_3 = Point.ByCoordinates(X_3, Y_3)
endPoint_2 = Curve.EndPoint(curve_2)
X_4 = Point.X(endPoint_2)
Y_4 = Point.Y(endPoint_2)
byCoordinates_4 = Point.ByCoordinates(X_4, Y_4)
byStartPointEndPoint_2 = Line.ByStartPointEndPoint(byCoordinates_3, byCoordinates_4)
Switch_2 = Input()
downlight_spline_2 = Custom[downlight spline](curve=byStartPointEndPoint_2, test=Switch_2, h=code_block.out0)
translate_2 = Geometry.Translate(downlight_spline_2, arg3=code_block_2)
NurbsCurve_2 = Output(translate_2)  # "NurbsCurve"
curve_3 = Input()
startPoint_3 = Curve.StartPoint(curve_3)
X_5 = Point.X(startPoint_3)
Y_5 = Point.Y(startPoint_3)
byCoordinates_5 = Point.ByCoordinates(X_5, Y_5)
endPoint_3 = Curve.EndPoint(curve_3)
X_6 = Point.X(endPoint_3)
Y_6 = Point.Y(endPoint_3)
byCoordinates_6 = Point.ByCoordinates(X_6, Y_6)
byStartPointEndPoint_3 = Line.ByStartPointEndPoint(byCoordinates_5, byCoordinates_6)
Switch_3 = Input()
downlight_spline_3 = Custom[downlight spline](curve=byStartPointEndPoint_3, test=Switch_3, h=code_block.out0)
translate_3 = Geometry.Translate(downlight_spline_3, arg3=code_block_2)
NurbsCurve_3 = Output(translate_3)  # "NurbsCurve"
curve_1 = Input()
startPoint_4 = Curve.StartPoint(curve_1)
X_7 = Point.X(startPoint_4)
Y_7 = Point.Y(startPoint_4)
byCoordinates_7 = Point.ByCoordinates(X_7, Y_7)
endPoint_4 = Curve.EndPoint(curve_1)
X_8 = Point.X(endPoint_4)
Y_8 = Point.Y(endPoint_4)
byCoordinates_8 = Point.ByCoordinates(X_8, Y_8)
byStartPointEndPoint_4 = Line.ByStartPointEndPoint(byCoordinates_7, byCoordinates_8)
Switch_1 = Input()
downlight_spline_4 = Custom[downlight spline](curve=byStartPointEndPoint_4, test=Switch_1, h=code_block.out0)
translate_4 = Geometry.Translate(downlight_spline_4, arg3=code_block_2)
NurbsCurve_4 = Output(translate_4)  # "NurbsCurve"
curve_5 = Input()
startPoint_5 = Curve.StartPoint(curve_5)
X_9 = Point.X(startPoint_5)
Y_9 = Point.Y(startPoint_5)
byCoordinates_9 = Point.ByCoordinates(X_9, Y_9)
endPoint_5 = Curve.EndPoint(curve_5)
X_10 = Point.X(endPoint_5)
Y_10 = Point.Y(endPoint_5)
byCoordinates_10 = Point.ByCoordinates(X_10, Y_10)
byStartPointEndPoint_5 = Line.ByStartPointEndPoint(byCoordinates_9, byCoordinates_10)
Switch_5 = Input()
downlight_spline_5 = Custom[downlight spline](curve=byStartPointEndPoint_5, test=Switch_5, h=code_block.out0)
translate_5 = Geometry.Translate(downlight_spline_5, arg3=code_block_2)
NurbsCurve_5 = Output(translate_5)  # "NurbsCurve"
