# Dynamo custom node Full Pearlescent surface.dyf (Dynamo 0.7.5.3566)
# category: Geometry.Solid.Query
# gives full pearlescent face from edges and propper vault

propper_solid_vault = Input()
edge_1 = Input()
count = Count(propper_solid_vault)
cycle = List.Cycle(edge_1, count)
doesIntersect = Geometry.DoesIntersect(cycle, propper_solid_vault)
filterByBoolMask = List.FilterByBoolMask(propper_solid_vault, doesIntersect)
edge_2 = Input()
count_2 = Count(filterByBoolMask)
cycle_2 = List.Cycle(edge_2, count_2)
doesIntersect_2 = Geometry.DoesIntersect(cycle_2, filterByBoolMask)
filterByBoolMask_2 = List.FilterByBoolMask(filterByBoolMask, doesIntersect_2)
flatten = Flatten(filterByBoolMask_2)
Pearlescent_surface = Output(flatten)
