# Dynamo custom node Higher lower point.dyf (Dynamo 0.7.5.3566)
# category: Geometry.Curve.Actions
# gives higher and lower points

curve = Input()
endPoint = Curve.EndPoint(curve)
Z = Point.Z(endPoint)
startPoint = Curve.StartPoint(curve)
Z_2 = Point.Z(startPoint)
code_block = CodeBlock(a=Z, b=Z_2) { a>b; }
filterByBoolMask = List.FilterByBoolMask(endPoint, code_block)
highest_points = Output(filterByBoolMask.out0)
lowest_points = Output(filterByBoolMask.out1)
