# Dynamo custom node Highest n points.dyf (Dynamo 0.7.5.3566)
# category: Geometry.Point.Actions
# gives highest n points of a list

list_of_point = Input()
Z = Point.Z(list_of_point)
sort = List.Sort(Z)
n = Input()
code_block = CodeBlock(n=n) { n+1; }
getItemAtIndex = List.GetItemAtIndex(sort, code_block)
code_block_2 = CodeBlock(a=Z, b=getItemAtIndex) { a>=b; }
filterByBoolMask = List.FilterByBoolMask(list_of_point, code_block_2)
highest_points = Output(filterByBoolMask.out0)
lowest_points = Output(filterByBoolMask.out1)
