# Dynamo custom node Highest.lowest points.dyf (Dynamo 0.7.5.3566)
# category: Geometry.Curve.Query
# gives curves highest and lowest points

curve = Input()
endPoint = Curve.EndPoint(curve)
Z = Point.Z(endPoint)
startPoint = Curve.StartPoint(curve)
Z_2 = Point.Z(startPoint)
code_block = CodeBlock(a=Z, b=Z_2) { a>b; }
filterByBoolMask = List.FilterByBoolMask(endPoint, code_block)
code_block_2 = CodeBlock(a=Z_2, b=Z) { a>b; }
filterByBoolMask_2 = List.FilterByBoolMask(startPoint, code_block_2)
create = List.Create(filterByBoolMask.out1, filterByBoolMask_2.out1)
lowest = Output(create)
create_2 = List.Create(filterByBoolMask.out0, filterByBoolMask_2.out0)
Highest = Output(create_2)
