# Dynamo custom node Inside surface.dyf (Dynamo 0.7.5.3566)
# category: Geometry.Solid.Actions
# Gets outside surface from solid face

Solid_face = Input()
explode = Geometry.Explode(Solid_face)
flatten = Flatten(explode)
area = Surface.Area(flatten)
code_block = CodeBlock { 0; }
sortIndexByValue = SortIndexByValue(area, code_block)
getItemAtIndex = List.GetItemAtIndex(flatten, sortIndexByValue)
code_block_2 = CodeBlock { 1; }
getItemAtIndex_2 = List.GetItemAtIndex(getItemAtIndex, code_block_2)
Inside_surface = Output(getItemAtIndex_2)
