# Dynamo custom node LIght lines partie basse.dyf (Dynamo 0.7.5.3566)
# category: Geometry.Solid.Create
# gives light lines from solid pearlescent surface

Light_line_start_height = Input()
code_block = CodeBlock(hauteur=Light_line_start_height) { hauteur; }
xy_plane_at_height = Custom[XY plane at height](Height=code_block)  # gives a XY plane at a given height
switch_light_line_slope = Input()
Pearlescent_solid_face = Input()
outside_surface = Custom[Outside surface](Solid_face=Pearlescent_solid_face)  # Gets outside surface from solid face
perimeterCurves = Surface.PerimeterCurves(outside_surface)
code_block_2 = CodeBlock { 0; 2; }
getItemAtIndex = List.GetItemAtIndex(perimeterCurves, code_block_2.out0)
intersect = Geometry.Intersect(getItemAtIndex, xy_plane_at_height)
getItemAtIndex_2 = List.GetItemAtIndex(perimeterCurves, code_block_2.out1)
intersect_2 = Geometry.Intersect(getItemAtIndex_2, xy_plane_at_height)
if_ = If(switch_light_line_slope, intersect, intersect_2)
X = Point.X(intersect_2)
Y = Point.Y(intersect_2)
code_block_3 = CodeBlock { -20; }
byCoordinates = Point.ByCoordinates(X, Y, code_block_3)
byThreePoints = Plane.ByThreePoints(intersect, intersect_2, byCoordinates)
normal = Plane.Normal(byThreePoints)
code_block_4 = CodeBlock { 50; -50; 0; }
if_2 = If(switch_light_line_slope, code_block_4.out0, code_block_4.out1)
rotate = Geometry.Rotate(xy_plane_at_height, if_, normal, if_2)
number_of_primary_light_lines = Input()
code_block_5 = CodeBlock(n=number_of_primary_light_lines)
# ---------- code_block_5.designscript (23 lines) ----------
//Number of primary light lines

n;

//light line width

0.08;

//light line depth

0.07;

//Light line thickness

0.02;

// light low point in case of double height

-3;

//tile width;

0.125;
# ----------------------------------------
code_block_6 = CodeBlock(n=code_block_5.n) { n; }
ofRepeatedItem = List.OfRepeatedItem(rotate, code_block_6)
flatten = Flatten(ofRepeatedItem)
code_block_7 = CodeBlock(x=code_block_5.out3) { x; }
light_lines_surfaces = Custom[Light lines surfaces](surface=outside_surface, n=code_block_5.n, lw=code_block_5.out1, lth=code_block_7)  # gives surfaces
flatten_2 = Flatten(light_lines_surfaces.central_line)
intersect_3 = Geometry.Intersect(flatten, flatten_2)
flatten_3 = Flatten(intersect_3)
Z = Point.Z(flatten_3)
takeItems = List.TakeItems(Z, code_block_6)
XY = Plane.XY()
code_block_8 = CodeBlock { 1; }
sortIndexByValue = SortIndexByValue(Z, code_block_8)
takeItems_2 = List.TakeItems(sortIndexByValue, code_block_6)
getItemAtIndex_3 = List.GetItemAtIndex(Z, takeItems_2)
translate = Geometry.Translate(XY, arg3=getItemAtIndex_3)
reverse = List.Reverse(translate)
if_3 = If(switch_light_line_slope, reverse, translate)
byCoordinates_2 = Point.ByCoordinates()
trim = Geometry.Trim(light_lines_surfaces.Surface0, if_3, byCoordinates_2)
flatten_4 = Flatten(trim)
code_block_9 = CodeBlock(ld=code_block_5.out2, lth=code_block_5.out3) { 2*ld; 2*(ld)+lth; }
code_block_10 = CodeBlock { 1; }
thicken = Surface.Thicken(flatten_4, code_block_9.out0, code_block_10)
differenceAll = Solid.DifferenceAll(Pearlescent_solid_face, thicken)
flatten_5 = Flatten(differenceAll)
pearlescent_face = Output(flatten_5)
trim_2 = Geometry.Trim(light_lines_surfaces.Surface1, if_3, byCoordinates_2)
flatten_6 = Flatten(trim_2)
thicken_2 = Surface.Thicken(flatten_6, code_block_9.out1, code_block_10)
differenceAll_2 = Solid.DifferenceAll(thicken_2, thicken)
inside_surface = Custom[Inside surface](Solid_face=Pearlescent_solid_face)  # Gets outside surface from solid face
perimeterCurves_2 = Surface.PerimeterCurves(inside_surface)
byJoinedCurves = PolyCurve.ByJoinedCurves(perimeterCurves_2)
code_block_11 = CodeBlock { -0.5; }
offset_upwards = Custom[Offset upwards](surface=inside_surface, distance=code_block_11)  # Offsets a surface upwards
perimeterCurves_3 = Surface.PerimeterCurves(offset_upwards)
byJoinedCurves_2 = PolyCurve.ByJoinedCurves(perimeterCurves_3)
create = List.Create(byJoinedCurves, byJoinedCurves_2)
byLoft = Solid.ByLoft(create)
explode = Geometry.Explode(byLoft)
area = Surface.Area(explode)
code_block_12 = CodeBlock { 0; }
sortIndexByValue_2 = SortIndexByValue(area, code_block_12)
getItemAtIndex_4 = List.GetItemAtIndex(explode, sortIndexByValue_2)
code_block_13 = CodeBlock { 4; }
getItemAtIndex_5 = List.GetItemAtIndex(getItemAtIndex_4, code_block_13)
perimeterCurves_4 = Surface.PerimeterCurves(getItemAtIndex_5)
byJoinedCurves_3 = PolyCurve.ByJoinedCurves(perimeterCurves_4)
code_block_14 = CodeBlock { 0.5; }
offset_upwards_2 = Custom[Offset upwards](surface=getItemAtIndex_5, distance=code_block_14)
perimeterCurves_5 = Surface.PerimeterCurves(offset_upwards_2)
byJoinedCurves_4 = PolyCurve.ByJoinedCurves(perimeterCurves_5)
create_2 = List.Create(byJoinedCurves_3, byJoinedCurves_4)
byLoft_2 = Solid.ByLoft(create_2)
differenceAll_3 = Solid.DifferenceAll(differenceAll_2, byLoft_2)
lowest_point = Custom[Lowest point](curve=light_lines_surfaces.central_line)  # gest curve lower point
trim_3 = Geometry.Trim(differenceAll_3, inside_surface, lowest_point)
flatten_7 = Flatten(trim_3)
light_lines = Output(flatten_7)
