# Dynamo custom node Light geometry pr.dyf (Dynamo 0.7.5.3566)
# category: Geometry.Curve.Create
# tools for light line construction

index0 = Input()
highest_point = Custom[Highest point](curve=index0)  # gest curve lower point
index1 = Input()
highest_point_2 = Custom[Highest point](curve=index1)
byStartPointEndPoint = Line.ByStartPointEndPoint(highest_point, highest_point_2)
n = Input()
code_block = CodeBlock(n=n) { 0; 1; 1/(n+1); }
number_range = NumberRange(code_block.out0, code_block.out1, code_block.out2, lacing=Longest)
remove_first_last = Custom[Remove first last](list=number_range)  # removes first and last item of a list
pointAtParameter = Curve.PointAtParameter(byStartPointEndPoint, remove_first_last)
lowest_point = Custom[Lowest point](curve=index0)  # gest curve lower point
lowest_point_2 = Custom[Lowest point](curve=index1)
byStartPointEndPoint_2 = Line.ByStartPointEndPoint(lowest_point, lowest_point_2)
pointAtParameter_2 = Curve.PointAtParameter(byStartPointEndPoint_2, remove_first_last)
X = Point.X(pointAtParameter_2)
Y = Point.Y(pointAtParameter_2)
code_block_2 = CodeBlock { 5; }
byCoordinates = Point.ByCoordinates(X, Y, code_block_2)
byThreePoints = Plane.ByThreePoints(pointAtParameter, pointAtParameter_2, byCoordinates)
normal = Plane.Normal(byThreePoints)
w = Input()
code_block_3 = CodeBlock(w=w) { w/2; -w/2; }
translate = Geometry.Translate(byThreePoints, normal, code_block_3.out0)
intersect = Geometry.Intersect(translate, byStartPointEndPoint)
flatten = Flatten(intersect)
byTwoPoints = Vector.ByTwoPoints(lowest_point_2, lowest_point)
byOriginNormal = Plane.ByOriginNormal(pointAtParameter_2, byTwoPoints)
translate_2 = Geometry.Translate(byOriginNormal, byTwoPoints, code_block_3.out0)
code_block_4 = CodeBlock { 5; }
extendStart = Curve.ExtendStart(byStartPointEndPoint_2, code_block_4)
extendEnd = Curve.ExtendEnd(extendStart, code_block_4)
intersect_2 = Geometry.Intersect(translate_2, extendEnd)
flatten_2 = Flatten(intersect_2)
X_2 = Point.X(flatten_2)
Y_2 = Point.Y(flatten_2)
code_block_5 = CodeBlock { 5; }
byCoordinates_2 = Point.ByCoordinates(X_2, Y_2, code_block_5)
byThreePoints_2 = Plane.ByThreePoints(flatten, flatten_2, byCoordinates_2)
create = List.Create(index0, index1)
flatten_3 = Flatten(create)
byLoft = Surface.ByLoft(flatten_3)
intersect_3 = Geometry.Intersect(byThreePoints_2, byLoft)
Geometry = Output(intersect_3)  # "Geometry[]"
translate_3 = Geometry.Translate(byThreePoints, normal, code_block_3.out1)
intersect_4 = Geometry.Intersect(translate_3, byStartPointEndPoint)
flatten_4 = Flatten(intersect_4)
translate_4 = Geometry.Translate(byOriginNormal, byTwoPoints, code_block_3.out1)
code_block_6 = CodeBlock { 5; }
extendStart_2 = Curve.ExtendStart(byStartPointEndPoint_2, code_block_6)
extendEnd_2 = Curve.ExtendEnd(extendStart_2, code_block_6)
intersect_5 = Geometry.Intersect(translate_4, extendEnd_2)
flatten_5 = Flatten(intersect_5)
X_3 = Point.X(flatten_5)
Y_3 = Point.Y(flatten_5)
code_block_7 = CodeBlock { 5; }
byCoordinates_3 = Point.ByCoordinates(X_3, Y_3, code_block_7)
byThreePoints_3 = Plane.ByThreePoints(flatten_4, flatten_5, byCoordinates_3)
intersect_6 = Geometry.Intersect(byThreePoints_3, byLoft)
Geometry_2 = Output(intersect_6)  # "Geometry[]"
