# Dynamo custom node Light geometry sec.dyf (Dynamo 0.7.5.3566)
# category: Geometry.Curve.Create
# tools for light lines geometry

curve = Input()
highest_point = Custom[Highest point](curve=curve)  # gest curve lower point
lowest_point = Custom[Lowest point](curve=curve)  # gest curve lower point
X = Point.X(lowest_point)
Y = Point.Y(lowest_point)
code_block = CodeBlock { 5; }
byCoordinates = Point.ByCoordinates(X, Y, code_block)
byThreePoints = Plane.ByThreePoints(highest_point, lowest_point, byCoordinates)
normal = Plane.Normal(byThreePoints)
x = Input()
code_block_2 = CodeBlock(x=x) { 2*x; }
translate = Geometry.Translate(byThreePoints, normal, code_block_2)
entity = Input()
intersect = Geometry.Intersect(translate, entity)
Geometry = Output(intersect)  # "Geometry[]"
curve_2 = Input(curve)
highest_point_2 = Custom[Highest point](curve=curve_2)
lowest_point_2 = Custom[Lowest point](curve=curve_2)
X_2 = Point.X(lowest_point_2)
Y_2 = Point.Y(lowest_point_2)
code_block_3 = CodeBlock { 5; }
byCoordinates_2 = Point.ByCoordinates(X_2, Y_2, code_block_3)
byThreePoints_2 = Plane.ByThreePoints(highest_point_2, lowest_point_2, byCoordinates_2)
normal_2 = Plane.Normal(byThreePoints_2)
code_block_4 = CodeBlock(x=x) { -2*x; }
translate_2 = Geometry.Translate(byThreePoints_2, normal_2, code_block_4)
intersect_2 = Geometry.Intersect(translate_2, entity)
Geometry_2 = Output(intersect_2)  # "Geometry[]"
