# Dynamo custom node Light lines lower part.dyf (Dynamo 0.7.5.3566)
# category: Geometry.Solid.Create
# gives light lines from pearlescent  solid surface

pearlescent_solid_face = Input()
outside_surface = Custom[Outside surface](Solid_face=pearlescent_solid_face)  # Gets outside surface from solid face
perimeterCurves = Surface.PerimeterCurves(outside_surface)
code_block = CodeBlock { 0; 2; }
getItemAtIndex = List.GetItemAtIndex(perimeterCurves, code_block.out0)
highest_point = Custom[Highest point](curve=getItemAtIndex)  # gest curve lower point
getItemAtIndex_2 = List.GetItemAtIndex(perimeterCurves, code_block.out1)
highest_point_2 = Custom[Highest point](curve=getItemAtIndex_2)
byStartPointEndPoint = Line.ByStartPointEndPoint(highest_point, highest_point_2)
number_of_light_lines = Input()
code_block_2 = CodeBlock(n=number_of_light_lines) { 0; 1; 1/(n+1); }
number_range = NumberRange(code_block_2.out0, code_block_2.out1, code_block_2.out2, lacing=Longest)
remove_first_last = Custom[Remove first last](list=number_range)  # removes first and last item of a list
code_block_3 = CodeBlock()
# ---------- code_block_3.designscript (11 lines) ----------
//line width

0.08;

//line thickness

0.015;

//light line depth

0.07;
# ----------------------------------------
length = Curve.Length(byStartPointEndPoint)
code_block_4 = CodeBlock(a=remove_first_last, lw=code_block_3.out0, l=length, th=code_block_3.out1) { a+(lw/2)/l; a-(lw/2)/l; a+((lw/2)+th)/l; a-((lw/2)+th)/l; }
pointAtParameter = Curve.PointAtParameter(byStartPointEndPoint, code_block_4.out2)
lowest_point = Custom[Lowest point](curve=getItemAtIndex)  # gest curve lower point
lowest_point_2 = Custom[Lowest point](curve=getItemAtIndex_2)
byStartPointEndPoint_2 = Line.ByStartPointEndPoint(lowest_point, lowest_point_2)
pointAtParameter_2 = Curve.PointAtParameter(byStartPointEndPoint_2, code_block_4.out2)
byStartPointEndPoint_3 = Line.ByStartPointEndPoint(pointAtParameter, pointAtParameter_2)
pointAtParameter_3 = Curve.PointAtParameter(byStartPointEndPoint, code_block_4.out3)
pointAtParameter_4 = Curve.PointAtParameter(byStartPointEndPoint_2, code_block_4.out3)
byStartPointEndPoint_4 = Line.ByStartPointEndPoint(pointAtParameter_3, pointAtParameter_4)
create = List.Create(byStartPointEndPoint_3, byStartPointEndPoint_4)
flatten = Flatten(create)
code_block_5 = CodeBlock { 1; }
number_range_2 = NumberRange(code_block_5, number_of_light_lines, code_block_5, lacing=Longest)
takeEveryNthItem = List.TakeEveryNthItem(flatten, number_of_light_lines, number_range_2)
byLoft = Surface.ByLoft(takeEveryNthItem)
XY = Plane.XY()
pointAtParameter_5 = Curve.PointAtParameter(byStartPointEndPoint, remove_first_last)
pointAtParameter_6 = Curve.PointAtParameter(byStartPointEndPoint_2, remove_first_last)
byStartPointEndPoint_5 = Line.ByStartPointEndPoint(pointAtParameter_5, pointAtParameter_6)
Light_line_start_height = Input()
xy_plane_at_height = Custom[XY plane at height](Height=Light_line_start_height)  # gives a XY plane at a given height
switch_slope = Input()
intersect = Geometry.Intersect(xy_plane_at_height, getItemAtIndex)
intersect_2 = Geometry.Intersect(xy_plane_at_height, getItemAtIndex_2)
if_ = If(switch_slope, intersect, intersect_2)
X = Point.X(intersect)
Y = Point.Y(intersect)
code_block_6 = CodeBlock { -20; }
byCoordinates = Point.ByCoordinates(X, Y, code_block_6)
byThreePoints = Plane.ByThreePoints(intersect, intersect_2, byCoordinates)
normal = Plane.Normal(byThreePoints)
code_block_7 = CodeBlock { 50; -50; }
if_2 = If(switch_slope, code_block_7.out0, code_block_7.out1)
rotate = Geometry.Rotate(xy_plane_at_height, if_, normal, if_2)
count = Count(byStartPointEndPoint_5)
cycle = List.Cycle(rotate, count)
intersect_3 = Geometry.Intersect(byStartPointEndPoint_5, cycle)
flatten_2 = Flatten(intersect_3)
Z = Point.Z(flatten_2)
translate = Geometry.Translate(XY, arg3=Z)
pointAtParameter_7 = Curve.PointAtParameter(byStartPointEndPoint_2, code_block_4.out0)
trim = Geometry.Trim(byLoft, translate, pointAtParameter_7)
flatten_3 = Flatten(trim)
code_block_8 = CodeBlock(ld=code_block_3.out2, th=code_block_3.out1) { 2*ld; 2*(ld+th); }
code_block_9 = CodeBlock { 1; }
thicken = Surface.Thicken(flatten_3, code_block_8.out1, code_block_9)
pointAtParameter_8 = Curve.PointAtParameter(byStartPointEndPoint, code_block_4.out0)
byStartPointEndPoint_6 = Line.ByStartPointEndPoint(pointAtParameter_8, pointAtParameter_7)
pointAtParameter_9 = Curve.PointAtParameter(byStartPointEndPoint, code_block_4.out1)
pointAtParameter_10 = Curve.PointAtParameter(byStartPointEndPoint_2, code_block_4.out1)
byStartPointEndPoint_7 = Line.ByStartPointEndPoint(pointAtParameter_9, pointAtParameter_10)
create_2 = List.Create(byStartPointEndPoint_6, byStartPointEndPoint_7)
flatten_4 = Flatten(create_2)
takeEveryNthItem_2 = List.TakeEveryNthItem(flatten_4, number_of_light_lines, number_range_2)
byLoft_2 = Surface.ByLoft(takeEveryNthItem_2)
trim_2 = Geometry.Trim(byLoft_2, translate, pointAtParameter_7)
flatten_5 = Flatten(trim_2)
thicken_2 = Surface.Thicken(flatten_5, code_block_8.out0, code_block_9)
differenceAll = Solid.DifferenceAll(thicken, thicken_2)
inside_surface = Custom[Inside surface](Solid_face=pearlescent_solid_face)  # Gets outside surface from solid face
trim_3 = Geometry.Trim(differenceAll, inside_surface, pointAtParameter_10)
flatten_6 = Flatten(trim_3)
light_lines = Output(flatten_6)
differenceAll_2 = Solid.DifferenceAll(pearlescent_solid_face, thicken_2)
flatten_7 = Flatten(differenceAll_2)
pearlescent_surface = Output(flatten_7)
test = Output(getItemAtIndex)
