# Dynamo custom node Line + lenth.dyf (Dynamo 0.7.5.3566)
# category: Geometry.Cylinder.Create
# Line ans length output

startPoint = Input()
endPoint = Input()
byStartPointEndPoint = Line.ByStartPointEndPoint(startPoint, endPoint)
Line = Output(byStartPointEndPoint)
length = Curve.Length(byStartPointEndPoint)
Length = Output(length)
