# Dynamo custom node M1 EL PL.dyf (Dynamo 0.7.5.3566)
# category: Geometry.Curve.Actions
# doiwnlight from edges

index0 = Input()
index1 = Input()
index2 = Input()
index3 = Input()
index3_2 = Input(index3)
create = List.Create(index0, index1, index2, index3, index3_2)
list = Output(create)
code_block = CodeBlock { {0,1,2,3}; {1,2,3,4}; }
getItemAtIndex = List.GetItemAtIndex(create, code_block.out0)
getItemAtIndex_2 = List.GetItemAtIndex(create, code_block.out1)
create_2 = List.Create(getItemAtIndex, getItemAtIndex_2)
transpose = List.Transpose(create_2)
byLoft = Surface.ByLoft(transpose)
Surface = Output(byLoft)
