# Dynamo custom node M3 EL PL.dyf (Dynamo 0.7.5.3566)
# category: Geometry.Solid.Actions
# M3 from edges and M1

curve = Input()
startPoint = Curve.StartPoint(curve)
surface = Input()
code_block = CodeBlock { 0.5; }
normalAtParameter = Surface.NormalAtParameter(surface, code_block, code_block)
Z = Vector.Z(normalAtParameter)
code_block_2 = CodeBlock(z=Z) { z>=0; }
x = Input()
code_block_3 = CodeBlock(x=x) { x; -x; }
if_ = If(code_block_2, code_block_3.x, code_block_3.out1)
code_block_4 = CodeBlock(x=if_) { x[0]; }
create = List.Create(code_block_4, if_)
flatten = Flatten(create)
offset = Curve.Offset(curve, flatten)
startPoint_2 = Curve.StartPoint(offset)
byStartPointEndPoint = Line.ByStartPointEndPoint(startPoint, startPoint_2)
endPoint = Curve.EndPoint(curve)
endPoint_2 = Curve.EndPoint(offset)
byStartPointEndPoint_2 = Line.ByStartPointEndPoint(endPoint, endPoint_2)
create_2 = List.Create(byStartPointEndPoint, byStartPointEndPoint_2, offset, curve)
transpose = List.Transpose(create_2)
byJoinedCurves = PolyCurve.ByJoinedCurves(transpose)
code_block_5 = CodeBlock { {0,1,2,3}; {1,2,3,4}; }
getItemAtIndex = List.GetItemAtIndex(byJoinedCurves, code_block_5.out0)
getItemAtIndex_2 = List.GetItemAtIndex(byJoinedCurves, code_block_5.out1)
create_3 = List.Create(getItemAtIndex, getItemAtIndex_2)
transpose_2 = List.Transpose(create_3)
byLoft = Solid.ByLoft(transpose_2)
Solid = Output(byLoft)
