# Dynamo custom node Normale vers exterieur.dyf (Dynamo 0.7.5.3566)
# category: Geometry.Curve.Create
# donne normale dans le bon sens

curve = Input()
normal = Curve.Normal(curve)
Z = Vector.Z(normal)
code_block = CodeBlock(z=Z) { z<0; }
x = Input()
code_block_2 = CodeBlock(x=x) { x; -x; }
if_ = If(code_block, code_block_2.out1, code_block_2.x)
result = Output(if_)
