# Dynamo custom node Offset upwards.dyf (Dynamo 0.7.5.3566)
# category: Geometry.Surface.Actions
# Offsets a surface upwards

surface = Input()
code_block = CodeBlock { 0.5; }
normalAtParameter = Surface.NormalAtParameter(surface, code_block, code_block)
Z = Vector.Z(normalAtParameter)
code_block_2 = CodeBlock(z=Z) { z>0; }
flipNormalDirection = Surface.FlipNormalDirection(surface)
if_ = If(code_block_2, surface, flipNormalDirection)
distance = Input()
offset = Surface.Offset(if_, distance)
Surface = Output(offset)
