# Dynamo custom node Pattern 1.dyf (Dynamo 0.7.5.3566)
# category: Geometry.Curve.Create
# pattern par points

point = Input()
x = Input()
sidelength = Input()
y = Input()
angle = Input()
triangles = Custom[triangles](point=point, x=x, sidelength=sidelength, y=y, angle=angle)  # triangles from grid
curves = PolyCurve.Curves(triangles)
startPoint = Curve.StartPoint(curves)
ZAxis = Vector.ZAxis()
watch = Watch(point)
Y = Point.Y(watch)
maximumItem = List.MaximumItem(Y)
code_block = CodeBlock(Y=Y, max=maximumItem) { -(Y*13/max+1); }
code_block_2 = CodeBlock { 3; }
ofRepeatedItem = List.OfRepeatedItem(code_block, code_block_2)
transpose = List.Transpose(ofRepeatedItem)
rotate = Geometry.Rotate(curves, startPoint, ZAxis, transpose)
transpose_2 = List.Transpose(curves)
code_block_3 = CodeBlock(x=transpose_2)
# ---------- code_block_3.designscript (3 lines) ----------
{x[1],
x[2],
x[0]};
# ----------------------------------------
transpose_3 = List.Transpose(code_block_3)
startPoint_2 = Curve.StartPoint(transpose_3)
code_block_4 = CodeBlock(Y=Y, max=maximumItem) { -(Y*30/max+1); }
code_block_5 = CodeBlock { 3; }
ofRepeatedItem_2 = List.OfRepeatedItem(code_block_4, code_block_5)
transpose_4 = List.Transpose(ofRepeatedItem_2)
rotate_2 = Geometry.Rotate(transpose_3, startPoint_2, ZAxis, transpose_4)
intersect = Geometry.Intersect(rotate, rotate_2)
flatten = Flatten(intersect)
code_block_6 = CodeBlock { 3; }
chop = List.Chop(flatten, code_block_6)
startPoint_3 = Curve.StartPoint(rotate_2)
byTwoPoints = Vector.ByTwoPoints(chop, startPoint_3)
Rayon_arc_motif = Input()
translate = Geometry.Translate(chop, byTwoPoints, Rayon_arc_motif)
byStartPointEndPoint = Line.ByStartPointEndPoint(translate, startPoint_3)
transpose_5 = List.Transpose(byStartPointEndPoint)
flatten_2 = Flatten(transpose_5)
startPoint_4 = Curve.StartPoint(rotate)
byTwoPoints_2 = Vector.ByTwoPoints(chop, startPoint_4)
translate_2 = Geometry.Translate(chop, byTwoPoints_2, Rayon_arc_motif)
byStartPointEndPoint_2 = Line.ByStartPointEndPoint(translate_2, startPoint_4)
transpose_6 = List.Transpose(byStartPointEndPoint_2)
flatten_3 = Flatten(transpose_6)
transpose_7 = List.Transpose(translate)
flatten_4 = Flatten(transpose_7)
transpose_8 = List.Transpose(chop)
flatten_5 = Flatten(transpose_8)
transpose_9 = List.Transpose(translate_2)
flatten_6 = Flatten(transpose_9)
create = List.Create(flatten_4, flatten_5, flatten_6)
transpose_10 = List.Transpose(create)
code_block_7 = CodeBlock { 2; }
byControlPoints = NurbsCurve.ByControlPoints(transpose_10, code_block_7)
transpose_11 = List.Transpose(byControlPoints)
flatten_7 = Flatten(transpose_11)
create_2 = List.Create(flatten_2, flatten_3, flatten_7)
flatten_8 = Flatten(create_2)
count = Count(byStartPointEndPoint)
chop_2 = List.Chop(flatten_8, count)
transpose_12 = List.Transpose(chop_2)
byJoinedCurves = PolyCurve.ByJoinedCurves(transpose_12)
PolyCurve = Output(byJoinedCurves)
