# Dynamo custom node Pattern scale by pourcentage.dyf (Dynamo 0.7.5.3566)
# category: Geometry.Curve.Actions
# scales from 15 to 1.5

nombre_de_lignes = Input()
lists = Input()
transpose = List.Transpose(lists)
flatten = Flatten(transpose)
x = Input()
sidelength = Input()
y = Input()
Rayon_arc_motif = Input()
Angle = Input()
pattern_1 = Custom[Pattern 1](point=flatten, x=x, sidelength=sidelength, y=y, Rayon_arc_motif=Rayon_arc_motif, angle=Angle)  # pattern par points
Scale_pourcentage = Input()
scale = Geometry.Scale(pattern_1, Scale_pourcentage)
count = Count(lists)
chop = List.Chop(scale, count)
curves = PolyCurve.Curves(chop)
startPoint = Curve.StartPoint(curves)
byPoints = Polygon.ByPoints(startPoint)
center = Polygon.Center(byPoints)
byTwoPoints = Vector.ByTwoPoints(center, transpose)
translate = Geometry.Translate(chop, byTwoPoints)
Geometry = Output(translate)
