# Dynamo custom node Pattern scale.dyf (Dynamo 0.7.5.3566)
# category: Geometry.Curve.Actions
# scales patern fro 15 to 1.5

lists = Input()
transpose = List.Transpose(lists)
flatten = Flatten(transpose)
x = Input()
sidelength = Input()
y = Input()
Rayon_arc_motif = Input()
angle = Input()
pattern_1 = Custom[Pattern 1](point=flatten, x=x, sidelength=sidelength, y=y, Rayon_arc_motif=Rayon_arc_motif, angle=angle)  # pattern par points
nombre_de_lignes = Input()
code_block = CodeBlock(c=nombre_de_lignes) { 1; 0.1; 0.9/(c-1); }
number_range = NumberRange(code_block.out1, code_block.out0, code_block.out2)
reverse = List.Reverse(number_range)
count = Count(lists)
ofRepeatedItem = List.OfRepeatedItem(reverse, count)
transpose_2 = List.Transpose(ofRepeatedItem)
flatten_2 = Flatten(transpose_2)
scale = Geometry.Scale(pattern_1, flatten_2)
chop = List.Chop(scale, count)
curves = PolyCurve.Curves(chop)
startPoint = Curve.StartPoint(curves)
byPoints = Polygon.ByPoints(startPoint)
center = Polygon.Center(byPoints)
byTwoPoints = Vector.ByTwoPoints(center, transpose)
translate = Geometry.Translate(chop, byTwoPoints)
Geometry = Output(translate)
