# Dynamo custom node Primary light lines + Pearlescent solid face partie basse.dyf (Dynamo 0.7.5.3566)
# category: Geometry.Solid.Create
# Gives primary light lines and solid surface

Proper_solid_vault = Input()
Face_edge_2 = Input()
doesIntersect = Geometry.DoesIntersect(Face_edge_2, Proper_solid_vault, lacing=CrossProduct)
flatten = Flatten(doesIntersect)
filterByBoolMask = List.FilterByBoolMask(Proper_solid_vault, flatten)
code_block = CodeBlock { 1; }
chop = List.Chop(filterByBoolMask, code_block)
flatten_2 = Flatten(chop)
Face_edge_1 = Input()
count = Count(flatten_2)
cycle = List.Cycle(Face_edge_1, count)
doesIntersect_2 = Geometry.DoesIntersect(cycle, flatten_2)
filterByBoolMask_2 = List.FilterByBoolMask(flatten_2, doesIntersect_2)
flatten_3 = Flatten(filterByBoolMask_2)
lowest_point = Custom[Lowest point](curve=Face_edge_1)  # gest curve lower point
lowest_point_2 = Custom[Lowest point](curve=Face_edge_2)
byStartPointEndPoint = Line.ByStartPointEndPoint(lowest_point, lowest_point_2)
Number_of_primary_light_lines = Input()
code_block_2 = CodeBlock(n=Number_of_primary_light_lines) { 0; 1; 1/(n+1); }
number_range = NumberRange(code_block_2.out0, code_block_2.out1, code_block_2.out2, lacing=Longest)
remove_first_last = Custom[Remove first last](list=number_range)  # removes first and last item of a list
Light_line_width = Input()
Light_line_thickness = Input()
code_block_3 = CodeBlock(x=Light_line_width, e=Light_line_thickness) { x/2; x/2+e; }
length = Curve.Length(byStartPointEndPoint)
code_block_4 = CodeBlock(a=remove_first_last, x=code_block_3.out0, l=length, y=code_block_3.out1) { a+(x/l); a-(x/l); a+(y/l); a-(y/l); }
pointAtParameter = Curve.PointAtParameter(byStartPointEndPoint, code_block_4.out0)
highest_point = Custom[Highest point](curve=Face_edge_1)  # gest curve lower point
highest_point_2 = Custom[Highest point](curve=Face_edge_2)
byStartPointEndPoint_2 = Line.ByStartPointEndPoint(highest_point, highest_point_2)
length_2 = Curve.Length(byStartPointEndPoint_2)
code_block_5 = CodeBlock(a=remove_first_last, x=code_block_3.out0, l=length_2, y=code_block_3.out1) { a+(x/l); a-(x/l); a+(y/l); a-(y/l); }
pointAtParameter_2 = Curve.PointAtParameter(byStartPointEndPoint_2, code_block_5.out0)
X = Point.X(pointAtParameter_2)
Y = Point.Y(pointAtParameter_2)
byCoordinates = Point.ByCoordinates(X, Y)
byThreePoints = Plane.ByThreePoints(pointAtParameter, pointAtParameter_2, byCoordinates)
create = List.Create(Face_edge_1, Face_edge_2)
flatten_4 = Flatten(create)
byLoft = Surface.ByLoft(flatten_4)
intersect = Geometry.Intersect(byThreePoints, byLoft)
pointAtParameter_3 = Curve.PointAtParameter(byStartPointEndPoint, code_block_4.out1)
pointAtParameter_4 = Curve.PointAtParameter(byStartPointEndPoint_2, code_block_5.out1)
X_2 = Point.X(pointAtParameter_4)
Y_2 = Point.Y(pointAtParameter_4)
byCoordinates_2 = Point.ByCoordinates(X_2, Y_2)
byThreePoints_2 = Plane.ByThreePoints(pointAtParameter_3, pointAtParameter_4, byCoordinates_2)
intersect_2 = Geometry.Intersect(byThreePoints_2, byLoft)
create_2 = List.Create(intersect, intersect_2)
flatten_5 = Flatten(create_2)
code_block_6 = CodeBlock(n=Number_of_primary_light_lines) { 1; n; 1; }
number_range_2 = NumberRange(code_block_6.out0, code_block_6.n, code_block_6.out2, lacing=Longest)
takeEveryNthItem = List.TakeEveryNthItem(flatten_5, Number_of_primary_light_lines, number_range_2)
byLoft_2 = Surface.ByLoft(takeEveryNthItem)
pointAtParameter_5 = Curve.PointAtParameter(byStartPointEndPoint_2, remove_first_last)
pointAtParameter_6 = Curve.PointAtParameter(byStartPointEndPoint, remove_first_last)
X_3 = Point.X(pointAtParameter_6)
Y_3 = Point.Y(pointAtParameter_6)
code_block_7 = CodeBlock { 5; }
byCoordinates_3 = Point.ByCoordinates(X_3, Y_3, code_block_7)
byThreePoints_3 = Plane.ByThreePoints(pointAtParameter_5, pointAtParameter_6, byCoordinates_3)
intersect_3 = Geometry.Intersect(byThreePoints_3, byLoft)
flatten_6 = Flatten(intersect_3)
Slope_direction = Input()
if_ = If(Slope_direction, Face_edge_2, Face_edge_1)
Hauteur_depart = Input()
code_block_8 = CodeBlock(x=Hauteur_depart) { -x; }
xy_plane_at_height = Custom[XY plane at height](Height=code_block_8)  # gives a XY plane at a given height
intersect_4 = Geometry.Intersect(if_, xy_plane_at_height)
if_2 = If(Slope_direction, Face_edge_1, Face_edge_2)
intersect_5 = Geometry.Intersect(if_2, xy_plane_at_height)
X_4 = Point.X(intersect_5)
code_block_9 = CodeBlock { 1; }
Z = Point.Z(intersect_5)
byCoordinates_4 = Point.ByCoordinates(X_4, code_block_9, Z)
byThreePoints_4 = Plane.ByThreePoints(intersect_4, intersect_5, byCoordinates_4)
X_5 = Point.X(intersect_4)
Y_4 = Point.Y(intersect_4)
code_block_10 = CodeBlock { 0.5; }
byCoordinates_5 = Point.ByCoordinates(X_5, Y_4, code_block_10)
byThreePoints_5 = Plane.ByThreePoints(intersect_4, intersect_5, byCoordinates_5)
normal = Plane.Normal(byThreePoints_5)
code_block_11 = CodeBlock { 50; }
rotate = Geometry.Rotate(byThreePoints_4, intersect_4, normal, code_block_11)
flatten_7 = Flatten(rotate)
count_2 = Count(flatten_6)
cycle_2 = List.Cycle(flatten_7, count_2)
trim = Geometry.Trim(flatten_6, cycle_2, pointAtParameter_6)
flatten_8 = Flatten(trim)
highest_lowest_points = Custom[Highest.lowest points](curve=flatten_8)  # gives curves highest and lowest points
flatten_9 = Flatten(highest_lowest_points.lowest)
Z_2 = Point.Z(flatten_9)
code_block_12 = CodeBlock { 1; }
sortIndexByValue = SortIndexByValue(Z_2, code_block_12)
getItemAtIndex = List.GetItemAtIndex(flatten_9, sortIndexByValue)
takeItems = List.TakeItems(getItemAtIndex, Number_of_primary_light_lines)
Z_3 = Point.Z(takeItems)
xy_plane_at_height_2 = Custom[XY plane at height](Height=Z_3)
trim_2 = Geometry.Trim(byLoft_2, xy_plane_at_height_2, pointAtParameter_3)
flatten_10 = Flatten(trim_2)
Light_line_depth = Input()
code_block_13 = CodeBlock(e=Light_line_depth, th=Light_line_thickness) { 2*(e+th); 2*e; }
code_block_14 = CodeBlock { 1; }
thicken = Surface.Thicken(flatten_10, code_block_13.out1, code_block_14)
differenceAll = Solid.DifferenceAll(flatten_3, thicken)
pointAtParameter_7 = Curve.PointAtParameter(byStartPointEndPoint, code_block_4.out2)
pointAtParameter_8 = Curve.PointAtParameter(byStartPointEndPoint_2, code_block_5.out2)
X_6 = Point.X(pointAtParameter_8)
Y_5 = Point.Y(pointAtParameter_8)
byCoordinates_6 = Point.ByCoordinates(X_6, Y_5)
byThreePoints_6 = Plane.ByThreePoints(pointAtParameter_7, pointAtParameter_8, byCoordinates_6)
intersect_6 = Geometry.Intersect(byThreePoints_6, byLoft)
pointAtParameter_9 = Curve.PointAtParameter(byStartPointEndPoint, code_block_4.out3)
pointAtParameter_10 = Curve.PointAtParameter(byStartPointEndPoint_2, code_block_5.out3)
X_7 = Point.X(pointAtParameter_10)
Y_6 = Point.Y(pointAtParameter_10)
byCoordinates_7 = Point.ByCoordinates(X_7, Y_6)
byThreePoints_7 = Plane.ByThreePoints(pointAtParameter_9, pointAtParameter_10, byCoordinates_7)
intersect_7 = Geometry.Intersect(byThreePoints_7, byLoft)
create_3 = List.Create(intersect_6, intersect_7)
flatten_11 = Flatten(create_3)
takeEveryNthItem_2 = List.TakeEveryNthItem(flatten_11, Number_of_primary_light_lines, number_range_2)
byLoft_3 = Surface.ByLoft(takeEveryNthItem_2)
trim_3 = Geometry.Trim(byLoft_3, xy_plane_at_height_2, pointAtParameter)
flatten_12 = Flatten(trim_3)
thicken_2 = Surface.Thicken(flatten_12, code_block_13.out0, code_block_14)
differenceAll_2 = Solid.DifferenceAll(thicken_2, thicken)
split = Geometry.Split(differenceAll_2, byLoft)
flatten_13 = Flatten(split)
code_block_15 = CodeBlock { 2; }
code_block_16 = CodeBlock { 0; }
takeEveryNthItem_3 = List.TakeEveryNthItem(flatten_13, code_block_15, code_block_16)
unionAll = Solid.UnionAll(differenceAll, takeEveryNthItem_3)
Solid_Pearlescent_face_plus_light_lines = Output(unionAll)
