# Dynamo custom node Primary light lines + Pearlescent solid face universel.dyf (Dynamo 0.7.5.3566)
# category: Geometry.Solid.Create
# Gives primary light lines and solid surface

Proper_solid_vault = Input()
Face_edge_2 = Input()
doesIntersect = Geometry.DoesIntersect(Face_edge_2, Proper_solid_vault, lacing=CrossProduct)
flatten = Flatten(doesIntersect)
filterByBoolMask = List.FilterByBoolMask(Proper_solid_vault, flatten)
code_block = CodeBlock { 1; }
chop = List.Chop(filterByBoolMask, code_block)
flatten_2 = Flatten(chop)
Face_edge_1 = Input()
count = Count(flatten_2)
cycle = List.Cycle(Face_edge_1, count)
doesIntersect_2 = Geometry.DoesIntersect(cycle, flatten_2)
filterByBoolMask_2 = List.FilterByBoolMask(flatten_2, doesIntersect_2)
flatten_3 = Flatten(filterByBoolMask_2)
lowest_point = Custom[Lowest point](curve=Face_edge_1)  # gest curve lower point
lowest_point_2 = Custom[Lowest point](curve=Face_edge_2)
byStartPointEndPoint = Line.ByStartPointEndPoint(lowest_point, lowest_point_2)
Number_of_primary_light_lines = Input()
code_block_2 = CodeBlock(n=Number_of_primary_light_lines) { 0; 1; 1/(n+1); }
number_range = NumberRange(code_block_2.out0, code_block_2.out1, code_block_2.out2, lacing=Longest)
remove_first_last = Custom[Remove first last](list=number_range)  # removes first and last item of a list
Light_line_width = Input()
Light_line_thickness = Input()
code_block_3 = CodeBlock(x=Light_line_width, e=Light_line_thickness) { x/2; x/2+e; }
length = Curve.Length(byStartPointEndPoint)
code_block_4 = CodeBlock(a=remove_first_last, x=code_block_3.out0, l=length, y=code_block_3.out1) { a+(x/l); a-(x/l); a+(y/l); a-(y/l); }
pointAtParameter = Curve.PointAtParameter(byStartPointEndPoint, code_block_4.out0)
highest_point = Custom[Highest point](curve=Face_edge_1)  # gest curve lower point
highest_point_2 = Custom[Highest point](curve=Face_edge_2)
byStartPointEndPoint_2 = Line.ByStartPointEndPoint(highest_point, highest_point_2)
length_2 = Curve.Length(byStartPointEndPoint_2)
code_block_5 = CodeBlock(a=remove_first_last, x=code_block_3.out0, l=length_2, y=code_block_3.out1) { a+(x/l); a-(x/l); a+(y/l); a-(y/l); }
pointAtParameter_2 = Curve.PointAtParameter(byStartPointEndPoint_2, code_block_5.out0)
X = Point.X(pointAtParameter_2)
Y = Point.Y(pointAtParameter_2)
byCoordinates = Point.ByCoordinates(X, Y)
byThreePoints = Plane.ByThreePoints(pointAtParameter, pointAtParameter_2, byCoordinates)
create = List.Create(Face_edge_1, Face_edge_2)
flatten_4 = Flatten(create)
byLoft = Surface.ByLoft(flatten_4)
intersect = Geometry.Intersect(byThreePoints, byLoft)
pointAtParameter_3 = Curve.PointAtParameter(byStartPointEndPoint, code_block_4.out1)
pointAtParameter_4 = Curve.PointAtParameter(byStartPointEndPoint_2, code_block_5.out1)
X_2 = Point.X(pointAtParameter_4)
Y_2 = Point.Y(pointAtParameter_4)
byCoordinates_2 = Point.ByCoordinates(X_2, Y_2)
byThreePoints_2 = Plane.ByThreePoints(pointAtParameter_3, pointAtParameter_4, byCoordinates_2)
intersect_2 = Geometry.Intersect(byThreePoints_2, byLoft)
create_2 = List.Create(intersect, intersect_2)
flatten_5 = Flatten(create_2)
flatten_6 = Flatten(flatten_5)
Light_line_depth = Input()
code_block_6 = CodeBlock(d=Light_line_depth, th=Light_line_thickness, n=Number_of_primary_light_lines)
# ---------- code_block_6.designscript (11 lines) ----------
//light lines depth

d;

//light line thickness

th;

//light lines number

n;
# ----------------------------------------
code_block_7 = CodeBlock(d=code_block_6.d, th=code_block_6.th) { d+th; -d-th; d; -d; }
offset = Curve.Offset(flatten_6, code_block_7.d)
offset_2 = Curve.Offset(flatten_6, code_block_7.out3)
create_3 = List.Create(offset, offset_2)
flatten_7 = Flatten(create_3)
pointAtParameter_5 = Curve.PointAtParameter(byStartPointEndPoint, code_block_4.out2)
pointAtParameter_6 = Curve.PointAtParameter(byStartPointEndPoint_2, code_block_5.out2)
X_3 = Point.X(pointAtParameter_6)
Y_3 = Point.Y(pointAtParameter_6)
byCoordinates_3 = Point.ByCoordinates(X_3, Y_3)
byThreePoints_3 = Plane.ByThreePoints(pointAtParameter_5, pointAtParameter_6, byCoordinates_3)
intersect_3 = Geometry.Intersect(byThreePoints_3, byLoft)
pointAtParameter_7 = Curve.PointAtParameter(byStartPointEndPoint, code_block_4.out3)
pointAtParameter_8 = Curve.PointAtParameter(byStartPointEndPoint_2, code_block_5.out3)
X_4 = Point.X(pointAtParameter_8)
Y_4 = Point.Y(pointAtParameter_8)
byCoordinates_4 = Point.ByCoordinates(X_4, Y_4)
byThreePoints_4 = Plane.ByThreePoints(pointAtParameter_7, pointAtParameter_8, byCoordinates_4)
intersect_4 = Geometry.Intersect(byThreePoints_4, byLoft)
create_4 = List.Create(intersect_3, intersect_4)
flatten_8 = Flatten(create_4)
flatten_9 = Flatten(flatten_8)
offset_3 = Curve.Offset(flatten_9, code_block_7.out0)
count_2 = Count(offset_3)
code_block_8 = CodeBlock(c=count_2) { 1; c; }
number_range_2 = NumberRange(code_block_8.out0, code_block_8.c, code_block_8.out0, lacing=Longest)
takeEveryNthItem = List.TakeEveryNthItem(flatten_7, count_2, number_range_2)
byLoft_2 = Surface.ByLoft(takeEveryNthItem)
perimeterCurves = Surface.PerimeterCurves(byLoft_2)
byJoinedCurves = PolyCurve.ByJoinedCurves(perimeterCurves)
code_block_9 = CodeBlock(n=code_block_6.n) { 1; n; }
number_range_3 = NumberRange(code_block_9.out0, code_block_9.n, code_block_9.out0, lacing=Longest)
takeEveryNthItem_2 = List.TakeEveryNthItem(byJoinedCurves, code_block_6.n, number_range_3)
byLoft_3 = Solid.ByLoft(takeEveryNthItem_2)
pointAtParameter_9 = Curve.PointAtParameter(byStartPointEndPoint_2, remove_first_last)
pointAtParameter_10 = Curve.PointAtParameter(byStartPointEndPoint, remove_first_last)
X_5 = Point.X(pointAtParameter_10)
Y_5 = Point.Y(pointAtParameter_10)
code_block_10 = CodeBlock { 5; }
byCoordinates_5 = Point.ByCoordinates(X_5, Y_5, code_block_10)
byThreePoints_5 = Plane.ByThreePoints(pointAtParameter_9, pointAtParameter_10, byCoordinates_5)
intersect_5 = Geometry.Intersect(byThreePoints_5, byLoft)
flatten_10 = Flatten(intersect_5)
Slope_direction = Input()
if_ = If(Slope_direction, Face_edge_2, Face_edge_1)
Double_height = Input()  # "Double height?"
code_block_11 = CodeBlock { 1.5; 0; }
if_2 = If(Double_height, code_block_11.out1, code_block_11.out0)
xy_plane_at_height = Custom[XY plane at height](Height=if_2)  # gives a XY plane at a given height
intersect_6 = Geometry.Intersect(if_, xy_plane_at_height)
if_3 = If(Slope_direction, Face_edge_1, Face_edge_2)
intersect_7 = Geometry.Intersect(if_3, xy_plane_at_height)
X_6 = Point.X(intersect_7)
code_block_12 = CodeBlock { 1; }
Z = Point.Z(intersect_7)
byCoordinates_6 = Point.ByCoordinates(X_6, code_block_12, Z)
byThreePoints_6 = Plane.ByThreePoints(intersect_6, intersect_7, byCoordinates_6)
X_7 = Point.X(intersect_6)
Y_6 = Point.Y(intersect_6)
code_block_13 = CodeBlock { 0.5; }
byCoordinates_7 = Point.ByCoordinates(X_7, Y_6, code_block_13)
byThreePoints_7 = Plane.ByThreePoints(intersect_6, intersect_7, byCoordinates_7)
normal = Plane.Normal(byThreePoints_7)
code_block_14 = CodeBlock { 50; 0; }
if_4 = If(Double_height, code_block_14.out1, code_block_14.out0)
rotate = Geometry.Rotate(byThreePoints_6, intersect_6, normal, if_4)
flatten_11 = Flatten(rotate)
count_3 = Count(flatten_10)
cycle_2 = List.Cycle(flatten_11, count_3)
trim = Geometry.Trim(flatten_10, cycle_2, pointAtParameter_10)
flatten_12 = Flatten(trim)
highest_lowest_points = Custom[Highest.lowest points](curve=flatten_12)  # gives curves highest and lowest points
flatten_13 = Flatten(highest_lowest_points.lowest)
Z_2 = Point.Z(flatten_13)
code_block_15 = CodeBlock { 1; }
sortIndexByValue = SortIndexByValue(Z_2, code_block_15)
getItemAtIndex = List.GetItemAtIndex(flatten_13, sortIndexByValue)
takeItems = List.TakeItems(getItemAtIndex, Number_of_primary_light_lines)
Z_3 = Point.Z(takeItems)
xy_plane_at_height_2 = Custom[XY plane at height](Height=Z_3)
trim_2 = Geometry.Trim(byLoft_3, xy_plane_at_height_2, pointAtParameter_3)
flatten_14 = Flatten(trim_2)
differenceAll = Solid.DifferenceAll(flatten_3, flatten_14)
flatten_15 = Flatten(differenceAll)
offset_4 = Curve.Offset(flatten_9, code_block_7.out1)
create_5 = List.Create(offset_3, offset_4)
flatten_16 = Flatten(create_5)
takeEveryNthItem_3 = List.TakeEveryNthItem(flatten_16, count_2, number_range_2)
byLoft_4 = Surface.ByLoft(takeEveryNthItem_3)
perimeterCurves_2 = Surface.PerimeterCurves(byLoft_4)
byJoinedCurves_2 = PolyCurve.ByJoinedCurves(perimeterCurves_2)
takeEveryNthItem_4 = List.TakeEveryNthItem(byJoinedCurves_2, code_block_6.n, number_range_3)
byLoft_5 = Solid.ByLoft(takeEveryNthItem_4)
trim_3 = Geometry.Trim(byLoft_5, xy_plane_at_height_2, pointAtParameter)
flatten_17 = Flatten(trim_3)
differenceAll_2 = Solid.DifferenceAll(flatten_17, flatten_14)
inside_surface = Custom[Inside surface](Solid_face=flatten_3)  # Gets outside surface from solid face
split = Geometry.Split(differenceAll_2, inside_surface)
flatten_18 = Flatten(split)
code_block_16 = CodeBlock { 2; }
code_block_17 = CodeBlock { 1; }
takeEveryNthItem_5 = List.TakeEveryNthItem(flatten_18, code_block_16, code_block_17)
flatten_19 = Flatten(takeEveryNthItem_5)
unionAll = Solid.UnionAll(flatten_15, flatten_19)
Solid_Pearlescent_face_plus_light_lines = Output(unionAll)
if_5 = If(Slope_direction, Face_edge_1, Face_edge_2)
lowest_point_3 = Custom[Lowest point](curve=if_5)
if_6 = If(Slope_direction, Face_edge_2, Face_edge_1)
lowest_point_4 = Custom[Lowest point](curve=if_6)
byStartPointEndPoint_3 = Line.ByStartPointEndPoint(lowest_point_3, lowest_point_4)
ZAxis = Vector.ZAxis()
Hauteur_partie_basse = Input()
code_block_18 = CodeBlock { 0; }
if_7 = If(Double_height, Hauteur_partie_basse, code_block_18)
code_block_19 = CodeBlock(x=if_7) { -x; }
extrude = Curve.Extrude(byStartPointEndPoint_3, ZAxis, code_block_19)
Solid_Vault_partie_basse = Input()  # "Solid Vault  partie basse"
flatten_20 = Flatten(Solid_Vault_partie_basse)
code_block_20 = CodeBlock { 1; }
chop_2 = List.Chop(flatten_20, code_block_20)
count_4 = Count(flatten_20)
cycle_3 = List.Cycle(Face_edge_1, count_4)
code_block_21 = CodeBlock { 1; }
chop_3 = List.Chop(cycle_3, code_block_21)
doesIntersect_3 = Geometry.DoesIntersect(chop_2, chop_3)
filterByBoolMask_3 = List.FilterByBoolMask(chop_2, doesIntersect_3)
flatten_21 = Flatten(filterByBoolMask_3)
code_block_22 = CodeBlock { 1; }
chop_4 = List.Chop(flatten_21, code_block_22)
count_5 = Count(flatten_21)
cycle_4 = List.Cycle(Face_edge_2, count_5)
chop_5 = List.Chop(cycle_4, code_block_22)
doesIntersect_4 = Geometry.DoesIntersect(chop_4, chop_5)
filterByBoolMask_4 = List.FilterByBoolMask(chop_4, doesIntersect_4)
flatten_22 = Flatten(filterByBoolMask_4)
code_block_23 = CodeBlock(n=Number_of_primary_light_lines) { 0; 1; 1/(n+1); }
number_range_4 = NumberRange(code_block_23.out0, code_block_23.out1, code_block_23.out2, lacing=Longest)
remove_first_last_2 = Custom[Remove first last](list=number_range_4)
code_block_24 = CodeBlock(x=Light_line_width) { x/2; }
length_3 = Curve.Length(byStartPointEndPoint_3)
code_block_25 = CodeBlock(a=remove_first_last_2, x=code_block_24, l=length_3, th=Light_line_thickness) { a+(x/l); a-(x/l); a+(x/l)+th/l; a-(x/l)-th/l; }
pointAtParameter_11 = Curve.PointAtParameter(byStartPointEndPoint_3, code_block_25.out0)
translate = Geometry.Translate(pointAtParameter_11, ZAxis, code_block_19)
byStartPointEndPoint_4 = Line.ByStartPointEndPoint(pointAtParameter_11, translate)
pointAtParameter_12 = Curve.PointAtParameter(byStartPointEndPoint_3, code_block_25.out1)
translate_2 = Geometry.Translate(pointAtParameter_12, ZAxis, code_block_19)
byStartPointEndPoint_5 = Line.ByStartPointEndPoint(pointAtParameter_12, translate_2)
create_6 = List.Create(byStartPointEndPoint_4, byStartPointEndPoint_5)
flatten_23 = Flatten(create_6)
code_block_26 = CodeBlock(n=Number_of_primary_light_lines) { 1; n; 1; }
number_range_5 = NumberRange(code_block_26.out0, code_block_26.n, code_block_26.out2, lacing=Longest)
takeEveryNthItem_6 = List.TakeEveryNthItem(flatten_23, Number_of_primary_light_lines, number_range_5)
byLoft_6 = Surface.ByLoft(takeEveryNthItem_6)
Light_line_start_hight_in_case_of_double = Input(Light line start hight (in case of double hight))
translate_3 = Geometry.Translate(lowest_point_3, ZAxis, Light_line_start_hight_in_case_of_double)
code_block_27 = CodeBlock { 0; }
if_8 = If(Double_height, Light_line_start_hight_in_case_of_double, code_block_27)
code_block_28 = CodeBlock { 50; }
tan = Math.Tan(code_block_28)
code_block_29 = CodeBlock(z=if_8, l=length_3, tan=tan) { z+l*tan; }
translate_4 = Geometry.Translate(lowest_point_4, ZAxis, code_block_29)
byStartPointEndPoint_6 = Line.ByStartPointEndPoint(translate_3, translate_4)
pointAtParameter_13 = Curve.PointAtParameter(byStartPointEndPoint_3, remove_first_last_2)
translate_5 = Geometry.Translate(pointAtParameter_13, ZAxis, code_block_19)
byStartPointEndPoint_7 = Line.ByStartPointEndPoint(pointAtParameter_13, translate_5)
intersect_8 = Geometry.Intersect(byStartPointEndPoint_6, byStartPointEndPoint_7)
Z_4 = Point.Z(intersect_8)
xy_plane_at_height_3 = Custom[XY plane at height](Height=Z_4)
flatten_24 = Flatten(xy_plane_at_height_3)
trim_4 = Geometry.Trim(byLoft_6, flatten_24, translate_2)
code_block_30 = CodeBlock(d=Light_line_depth) { 2*d; }
code_block_31 = CodeBlock { 1; }
thicken = Surface.Thicken(trim_4, code_block_30, code_block_31)
flatten_25 = Flatten(thicken)
outside_surface = Custom[Outside surface](Solid_face=flatten_22)  # Gets outside surface from solid face
split_2 = Geometry.Split(flatten_25, outside_surface)
flatten_26 = Flatten(split_2)
code_block_32 = CodeBlock { 2; 0; }
takeEveryNthItem_7 = List.TakeEveryNthItem(flatten_26, code_block_32.out0, code_block_32.out1)
differenceAll_3 = Solid.DifferenceAll(flatten_22, takeEveryNthItem_7)
pointAtParameter_14 = Curve.PointAtParameter(byStartPointEndPoint_3, code_block_25.out2)
translate_6 = Geometry.Translate(pointAtParameter_14, ZAxis, code_block_19)
byStartPointEndPoint_8 = Line.ByStartPointEndPoint(pointAtParameter_14, translate_6)
pointAtParameter_15 = Curve.PointAtParameter(byStartPointEndPoint_3, code_block_25.out3)
translate_7 = Geometry.Translate(pointAtParameter_15, ZAxis, code_block_19)
byStartPointEndPoint_9 = Line.ByStartPointEndPoint(pointAtParameter_15, translate_7)
create_7 = List.Create(byStartPointEndPoint_8, byStartPointEndPoint_9)
flatten_27 = Flatten(create_7)
takeEveryNthItem_8 = List.TakeEveryNthItem(flatten_27, Number_of_primary_light_lines, number_range_5)
byLoft_7 = Surface.ByLoft(takeEveryNthItem_8)
trim_5 = Geometry.Trim(byLoft_7, flatten_24, translate_2)
code_block_33 = CodeBlock(d=Light_line_depth, th=Light_line_thickness) { 2*d+2*th; }
code_block_34 = CodeBlock { 1; }
thicken_2 = Surface.Thicken(trim_5, code_block_33, code_block_34)
flatten_28 = Flatten(thicken_2)
split_3 = Geometry.Split(flatten_28, outside_surface)
flatten_29 = Flatten(split_3)
code_block_35 = CodeBlock { 2; 0; }
takeEveryNthItem_9 = List.TakeEveryNthItem(flatten_29, code_block_35.out0, code_block_35.out1)
differenceAll_4 = Solid.DifferenceAll(takeEveryNthItem_9, takeEveryNthItem_7)
unionAll_2 = Solid.UnionAll(differenceAll_3, differenceAll_4)
Partie_basse_pearlescent_light_lines = Output(unionAll_2)  # "Partie basse pearlescent + light lines"
Output = Output(byLoft_5)  # ""
Output_2 = Output(differenceAll_2)  # ""
Output_3 = Output(flatten_19)  # ""
