# Dynamo custom node Primary light lines + Pearlescent solid face.dyf (Dynamo 0.7.5.3566)
# category: Geometry.Solid.Create
# Gives primary light lines and solid surface

Slope_direction = Input()
Full_surface = Input()  # "Full surface?"
Proper_solid_vault = Input()
Face_edge_1 = Input()
doesIntersect = Geometry.DoesIntersect(Face_edge_1, Proper_solid_vault, lacing=CrossProduct)
flatten = Flatten(doesIntersect)
filterByBoolMask = List.FilterByBoolMask(Proper_solid_vault, flatten)
code_block = CodeBlock { 1; }
chop = List.Chop(filterByBoolMask, code_block)
flatten_2 = Flatten(chop)
Face_edge_2 = Input()
count = Count(flatten_2)
cycle = List.Cycle(Face_edge_2, count)
doesIntersect_2 = Geometry.DoesIntersect(cycle, flatten_2)
filterByBoolMask_2 = List.FilterByBoolMask(flatten_2, doesIntersect_2)
flatten_3 = Flatten(filterByBoolMask_2)
Pearlescent_partial_surface = Input()
if_ = If(Full_surface, flatten_3, Pearlescent_partial_surface)
outside_surface = Custom[Outside surface](Solid_face=if_)  # Gets outside surface from solid face
perimeterCurves = Surface.PerimeterCurves(outside_surface)
code_block_2 = CodeBlock { 1; 3; 0; 2; }
getItemAtIndex = List.GetItemAtIndex(perimeterCurves, code_block_2.out2)
getItemAtIndex_2 = List.GetItemAtIndex(perimeterCurves, code_block_2.out3)
if_2 = If(Slope_direction, getItemAtIndex, getItemAtIndex_2)
lowest_point = Custom[Lowest point](curve=if_2)  # gest curve lower point
if_3 = If(Slope_direction, getItemAtIndex_2, getItemAtIndex)
lowest_point_2 = Custom[Lowest point](curve=if_3)
byStartPointEndPoint = Line.ByStartPointEndPoint(lowest_point, lowest_point_2)
ZAxis = Vector.ZAxis()
Double_height = Input()  # "Double height?"
Hauteur_partie_basse = Input()
code_block_3 = CodeBlock { 0; }
if_4 = If(Double_height, Hauteur_partie_basse, code_block_3)
code_block_4 = CodeBlock(x=if_4) { -x; }
extrude = Curve.Extrude(byStartPointEndPoint, ZAxis, code_block_4)
Solid_Vault_partie_basse = Input()  # "Solid Vault  partie basse"
flatten_4 = Flatten(Solid_Vault_partie_basse)
code_block_5 = CodeBlock { 1; }
chop_2 = List.Chop(flatten_4, code_block_5)
count_2 = Count(flatten_4)
cycle_2 = List.Cycle(getItemAtIndex, count_2)
code_block_6 = CodeBlock { 1; }
chop_3 = List.Chop(cycle_2, code_block_6)
doesIntersect_3 = Geometry.DoesIntersect(chop_2, chop_3)
filterByBoolMask_3 = List.FilterByBoolMask(chop_2, doesIntersect_3)
flatten_5 = Flatten(filterByBoolMask_3)
code_block_7 = CodeBlock { 1; }
chop_4 = List.Chop(flatten_5, code_block_7)
count_3 = Count(flatten_5)
cycle_3 = List.Cycle(getItemAtIndex_2, count_3)
chop_5 = List.Chop(cycle_3, code_block_7)
doesIntersect_4 = Geometry.DoesIntersect(chop_4, chop_5)
filterByBoolMask_4 = List.FilterByBoolMask(chop_4, doesIntersect_4)
flatten_6 = Flatten(filterByBoolMask_4)
Number_of_primary_light_lines = Input()
code_block_8 = CodeBlock(n=Number_of_primary_light_lines) { 0; 1; 1/(n+1); }
number_range = NumberRange(code_block_8.out0, code_block_8.out1, code_block_8.out2, lacing=Longest)
remove_first_last = Custom[Remove first last](list=number_range)  # removes first and last item of a list
Light_line_width = Input()
code_block_9 = CodeBlock(x=Light_line_width) { x/2; }
length = Curve.Length(byStartPointEndPoint)
Light_line_thickness = Input()
code_block_10 = CodeBlock(a=remove_first_last, x=code_block_9, l=length, th=Light_line_thickness) { a+(x/l); a-(x/l); a+(x/l)+th/l; a-(x/l)-th/l; }
pointAtParameter = Curve.PointAtParameter(byStartPointEndPoint, code_block_10.out0)
translate = Geometry.Translate(pointAtParameter, ZAxis, code_block_4)
byStartPointEndPoint_2 = Line.ByStartPointEndPoint(pointAtParameter, translate)
pointAtParameter_2 = Curve.PointAtParameter(byStartPointEndPoint, code_block_10.out1)
translate_2 = Geometry.Translate(pointAtParameter_2, ZAxis, code_block_4)
byStartPointEndPoint_3 = Line.ByStartPointEndPoint(pointAtParameter_2, translate_2)
create = List.Create(byStartPointEndPoint_2, byStartPointEndPoint_3)
flatten_7 = Flatten(create)
code_block_11 = CodeBlock(n=Number_of_primary_light_lines) { 1; n; 1; }
number_range_2 = NumberRange(code_block_11.out0, code_block_11.n, code_block_11.out2, lacing=Longest)
takeEveryNthItem = List.TakeEveryNthItem(flatten_7, Number_of_primary_light_lines, number_range_2)
byLoft = Surface.ByLoft(takeEveryNthItem)
Light_line_start_hight_in_case_of_double = Input(Light line start hight (in case of double hight))
translate_3 = Geometry.Translate(lowest_point, ZAxis, Light_line_start_hight_in_case_of_double)
code_block_12 = CodeBlock { 0; }
if_5 = If(Double_height, Light_line_start_hight_in_case_of_double, code_block_12)
code_block_13 = CodeBlock { 50; }
tan = Math.Tan(code_block_13)
code_block_14 = CodeBlock(z=if_5, l=length, tan=tan) { z+l*tan; }
translate_4 = Geometry.Translate(lowest_point_2, ZAxis, code_block_14)
byStartPointEndPoint_4 = Line.ByStartPointEndPoint(translate_3, translate_4)
pointAtParameter_3 = Curve.PointAtParameter(byStartPointEndPoint, remove_first_last)
translate_5 = Geometry.Translate(pointAtParameter_3, ZAxis, code_block_4)
byStartPointEndPoint_5 = Line.ByStartPointEndPoint(pointAtParameter_3, translate_5)
intersect = Geometry.Intersect(byStartPointEndPoint_4, byStartPointEndPoint_5)
Z = Point.Z(intersect)
xy_plane_at_height = Custom[XY plane at height](Height=Z)  # gives a XY plane at a given height
flatten_8 = Flatten(xy_plane_at_height)
trim = Geometry.Trim(byLoft, flatten_8, translate_2)
Light_line_depth = Input()
code_block_15 = CodeBlock(d=Light_line_depth) { 2*d; }
code_block_16 = CodeBlock { 1; }
thicken = Surface.Thicken(trim, code_block_15, code_block_16)
flatten_9 = Flatten(thicken)
outside_surface_2 = Custom[Outside surface](Solid_face=flatten_6)
split = Geometry.Split(flatten_9, outside_surface_2)
flatten_10 = Flatten(split)
code_block_17 = CodeBlock { 2; 0; }
takeEveryNthItem_2 = List.TakeEveryNthItem(flatten_10, code_block_17.out0, code_block_17.out1)
differenceAll = Solid.DifferenceAll(flatten_6, takeEveryNthItem_2)
pointAtParameter_4 = Curve.PointAtParameter(byStartPointEndPoint, code_block_10.out2)
translate_6 = Geometry.Translate(pointAtParameter_4, ZAxis, code_block_4)
byStartPointEndPoint_6 = Line.ByStartPointEndPoint(pointAtParameter_4, translate_6)
pointAtParameter_5 = Curve.PointAtParameter(byStartPointEndPoint, code_block_10.out3)
translate_7 = Geometry.Translate(pointAtParameter_5, ZAxis, code_block_4)
byStartPointEndPoint_7 = Line.ByStartPointEndPoint(pointAtParameter_5, translate_7)
create_2 = List.Create(byStartPointEndPoint_6, byStartPointEndPoint_7)
flatten_11 = Flatten(create_2)
takeEveryNthItem_3 = List.TakeEveryNthItem(flatten_11, Number_of_primary_light_lines, number_range_2)
byLoft_2 = Surface.ByLoft(takeEveryNthItem_3)
trim_2 = Geometry.Trim(byLoft_2, flatten_8, translate_2)
code_block_18 = CodeBlock(d=Light_line_depth, th=Light_line_thickness) { 2*d+2*th; }
code_block_19 = CodeBlock { 1; }
thicken_2 = Surface.Thicken(trim_2, code_block_18, code_block_19)
flatten_12 = Flatten(thicken_2)
split_2 = Geometry.Split(flatten_12, outside_surface_2)
flatten_13 = Flatten(split_2)
code_block_20 = CodeBlock { 2; 0; }
takeEveryNthItem_4 = List.TakeEveryNthItem(flatten_13, code_block_20.out0, code_block_20.out1)
differenceAll_2 = Solid.DifferenceAll(takeEveryNthItem_4, takeEveryNthItem_2)
unionAll = Solid.UnionAll(differenceAll, differenceAll_2)
Partie_basse_pearlescent_light_lines = Output(unionAll)  # "Partie basse pearlescent + light lines"
code_block_21 = CodeBlock()  # //full surface?
lowest_point_3 = Custom[Lowest point](curve=getItemAtIndex)
lowest_point_4 = Custom[Lowest point](curve=getItemAtIndex_2)
byStartPointEndPoint_8 = Line.ByStartPointEndPoint(lowest_point_3, lowest_point_4)
code_block_22 = CodeBlock(n=Number_of_primary_light_lines) { 0; 1; 1/(n+1); }
number_range_3 = NumberRange(code_block_22.out0, code_block_22.out1, code_block_22.out2, lacing=Longest)
remove_first_last_2 = Custom[Remove first last](list=number_range_3)
code_block_23 = CodeBlock(x=Light_line_width, e=Light_line_thickness) { x/2; x/2+e; }
length_2 = Curve.Length(byStartPointEndPoint_8)
code_block_24 = CodeBlock(a=remove_first_last_2, x=code_block_23.out0, l=length_2, y=code_block_23.out1) { a+(x/l); a-(x/l); a+(y/l); a-(y/l); }
pointAtParameter_6 = Curve.PointAtParameter(byStartPointEndPoint_8, code_block_24.out0)
highest_point = Custom[Highest point](curve=getItemAtIndex)  # gest curve lower point
highest_point_2 = Custom[Highest point](curve=getItemAtIndex_2)
byStartPointEndPoint_9 = Line.ByStartPointEndPoint(highest_point, highest_point_2)
length_3 = Curve.Length(byStartPointEndPoint_9)
code_block_25 = CodeBlock(a=remove_first_last_2, x=code_block_23.out0, l=length_3, y=code_block_23.out1) { a+(x/l); a-(x/l); a+(y/l); a-(y/l); }
pointAtParameter_7 = Curve.PointAtParameter(byStartPointEndPoint_9, code_block_25.out0)
X = Point.X(pointAtParameter_7)
Y = Point.Y(pointAtParameter_7)
byCoordinates = Point.ByCoordinates(X, Y)
byThreePoints = Plane.ByThreePoints(pointAtParameter_6, pointAtParameter_7, byCoordinates)
create_3 = List.Create(getItemAtIndex, getItemAtIndex_2)
flatten_14 = Flatten(create_3)
byLoft_3 = Surface.ByLoft(flatten_14)
intersect_2 = Geometry.Intersect(byThreePoints, byLoft_3)
pointAtParameter_8 = Curve.PointAtParameter(byStartPointEndPoint_8, code_block_24.out1)
pointAtParameter_9 = Curve.PointAtParameter(byStartPointEndPoint_9, code_block_25.out1)
X_2 = Point.X(pointAtParameter_9)
Y_2 = Point.Y(pointAtParameter_9)
byCoordinates_2 = Point.ByCoordinates(X_2, Y_2)
byThreePoints_2 = Plane.ByThreePoints(pointAtParameter_8, pointAtParameter_9, byCoordinates_2)
intersect_3 = Geometry.Intersect(byThreePoints_2, byLoft_3)
create_4 = List.Create(intersect_2, intersect_3)
flatten_15 = Flatten(create_4)
code_block_26 = CodeBlock(n=Number_of_primary_light_lines) { 1; n; 1; }
number_range_4 = NumberRange(code_block_26.out0, code_block_26.n, code_block_26.out2, lacing=Longest)
takeEveryNthItem_5 = List.TakeEveryNthItem(flatten_15, Number_of_primary_light_lines, number_range_4)
byLoft_4 = Surface.ByLoft(takeEveryNthItem_5)
reverse = List.Reverse(byLoft_4)
if_6 = If(Slope_direction, byLoft_4, reverse)
pointAtParameter_10 = Curve.PointAtParameter(byStartPointEndPoint_9, remove_first_last_2)
pointAtParameter_11 = Curve.PointAtParameter(byStartPointEndPoint_8, remove_first_last_2)
X_3 = Point.X(pointAtParameter_11)
Y_3 = Point.Y(pointAtParameter_11)
code_block_27 = CodeBlock { 5; }
byCoordinates_3 = Point.ByCoordinates(X_3, Y_3, code_block_27)
byThreePoints_3 = Plane.ByThreePoints(pointAtParameter_10, pointAtParameter_11, byCoordinates_3)
intersect_4 = Geometry.Intersect(byThreePoints_3, byLoft_3)
flatten_16 = Flatten(intersect_4)
if_7 = If(Slope_direction, getItemAtIndex_2, getItemAtIndex)
code_block_28 = CodeBlock { 1.5; 0; }
if_8 = If(Double_height, code_block_28.out1, code_block_28.out0)
xy_plane_at_height_2 = Custom[XY plane at height](Height=if_8)
intersect_5 = Geometry.Intersect(if_7, xy_plane_at_height_2)
if_9 = If(Slope_direction, getItemAtIndex, getItemAtIndex_2)
intersect_6 = Geometry.Intersect(if_9, xy_plane_at_height_2)
X_4 = Point.X(intersect_6)
code_block_29 = CodeBlock { 1; }
Z_2 = Point.Z(intersect_6)
byCoordinates_4 = Point.ByCoordinates(X_4, code_block_29, Z_2)
byThreePoints_4 = Plane.ByThreePoints(intersect_5, intersect_6, byCoordinates_4)
X_5 = Point.X(intersect_5)
Y_4 = Point.Y(intersect_5)
code_block_30 = CodeBlock { 0.5; }
byCoordinates_5 = Point.ByCoordinates(X_5, Y_4, code_block_30)
byThreePoints_5 = Plane.ByThreePoints(intersect_5, intersect_6, byCoordinates_5)
normal = Plane.Normal(byThreePoints_5)
code_block_31 = CodeBlock { 50; 0; }
if_10 = If(Double_height, code_block_31.out1, code_block_31.out0)
rotate = Geometry.Rotate(byThreePoints_4, intersect_5, normal, if_10)
flatten_17 = Flatten(rotate)
count_4 = Count(flatten_16)
cycle_4 = List.Cycle(flatten_17, count_4)
trim_3 = Geometry.Trim(flatten_16, cycle_4, pointAtParameter_11)
flatten_18 = Flatten(trim_3)
highest_lowest_points = Custom[Highest.lowest points](curve=flatten_18)  # gives curves highest and lowest points
flatten_19 = Flatten(highest_lowest_points.lowest)
Z_3 = Point.Z(flatten_19)
code_block_32 = CodeBlock { 1; }
sortIndexByValue = SortIndexByValue(Z_3, code_block_32)
getItemAtIndex_3 = List.GetItemAtIndex(flatten_19, sortIndexByValue)
takeItems = List.TakeItems(getItemAtIndex_3, Number_of_primary_light_lines)
Z_4 = Point.Z(takeItems)
xy_plane_at_height_3 = Custom[XY plane at height](Height=Z_4)
trim_4 = Geometry.Trim(if_6, xy_plane_at_height_3, pointAtParameter_8)
flatten_20 = Flatten(trim_4)
code_block_33 = CodeBlock(e=Light_line_depth, th=Light_line_thickness) { 2*(e+th); 2*e; }
code_block_34 = CodeBlock { 1; }
thicken_3 = Surface.Thicken(flatten_20, code_block_33.out1, code_block_34)
differenceAll_3 = Solid.DifferenceAll(if_, thicken_3)
flatten_21 = Flatten(differenceAll_3)
Pearlescent_surface_line_lights = Output(flatten_21)  # "Pearlescent surface - line lights"
pointAtParameter_12 = Curve.PointAtParameter(byStartPointEndPoint_8, code_block_24.out2)
pointAtParameter_13 = Curve.PointAtParameter(byStartPointEndPoint_9, code_block_25.out2)
X_6 = Point.X(pointAtParameter_13)
Y_5 = Point.Y(pointAtParameter_13)
byCoordinates_6 = Point.ByCoordinates(X_6, Y_5)
byThreePoints_6 = Plane.ByThreePoints(pointAtParameter_12, pointAtParameter_13, byCoordinates_6)
intersect_7 = Geometry.Intersect(byThreePoints_6, byLoft_3)
pointAtParameter_14 = Curve.PointAtParameter(byStartPointEndPoint_8, code_block_24.out3)
pointAtParameter_15 = Curve.PointAtParameter(byStartPointEndPoint_9, code_block_25.out3)
X_7 = Point.X(pointAtParameter_15)
Y_6 = Point.Y(pointAtParameter_15)
byCoordinates_7 = Point.ByCoordinates(X_7, Y_6)
byThreePoints_7 = Plane.ByThreePoints(pointAtParameter_14, pointAtParameter_15, byCoordinates_7)
intersect_8 = Geometry.Intersect(byThreePoints_7, byLoft_3)
create_5 = List.Create(intersect_7, intersect_8)
flatten_22 = Flatten(create_5)
takeEveryNthItem_6 = List.TakeEveryNthItem(flatten_22, Number_of_primary_light_lines, number_range_4)
byLoft_5 = Surface.ByLoft(takeEveryNthItem_6)
reverse_2 = List.Reverse(byLoft_5)
if_11 = If(Slope_direction, byLoft_5, reverse_2)
trim_5 = Geometry.Trim(if_11, xy_plane_at_height_3, pointAtParameter_6)
flatten_23 = Flatten(trim_5)
thicken_4 = Surface.Thicken(flatten_23, code_block_33.out0, code_block_34)
differenceAll_4 = Solid.DifferenceAll(thicken_4, thicken_3)
getItemAtIndex_4 = List.GetItemAtIndex(perimeterCurves, code_block_2.out0)
highest_point_3 = Custom[Highest point](curve=getItemAtIndex_4)
Z_5 = Point.Z(highest_point_3)
getItemAtIndex_5 = List.GetItemAtIndex(perimeterCurves, code_block_2.out1)
highest_point_4 = Custom[Highest point](curve=getItemAtIndex_5)
Z_6 = Point.Z(highest_point_4)
code_block_35 = CodeBlock(a=Z_5, b=Z_6) { a<b; }
if_12 = If(code_block_35, getItemAtIndex_5, getItemAtIndex_4)
ZAxis_2 = Vector.ZAxis()
code_block_36 = CodeBlock { -0.5; }
extrude_2 = Curve.Extrude(if_12, ZAxis_2, code_block_36)
perimeterCurves_2 = Surface.PerimeterCurves(extrude_2)
byJoinedCurves = PolyCurve.ByJoinedCurves(perimeterCurves_2)
inside_surface = Custom[Inside surface](Solid_face=if_)  # Gets outside surface from solid face
perimeterCurves_3 = Surface.PerimeterCurves(inside_surface)
getItemAtIndex_6 = List.GetItemAtIndex(perimeterCurves_3, code_block_2.out0)
highest_point_5 = Custom[Highest point](curve=getItemAtIndex_6)
Z_7 = Point.Z(highest_point_5)
getItemAtIndex_7 = List.GetItemAtIndex(perimeterCurves_3, code_block_2.out1)
highest_point_6 = Custom[Highest point](curve=getItemAtIndex_7)
Z_8 = Point.Z(highest_point_6)
code_block_37 = CodeBlock(a=Z_7, b=Z_8) { a<b; }
if_13 = If(code_block_37, getItemAtIndex_7, getItemAtIndex_6)
code_block_38 = CodeBlock { 0.5; }
extrude_3 = Curve.Extrude(if_13, ZAxis_2, code_block_38)
perimeterCurves_4 = Surface.PerimeterCurves(extrude_3)
byJoinedCurves_2 = PolyCurve.ByJoinedCurves(perimeterCurves_4)
create_6 = List.Create(byJoinedCurves, byJoinedCurves_2)
byLoft_6 = Solid.ByLoft(create_6)
differenceAll_5 = Solid.DifferenceAll(differenceAll_4, byLoft_6)
inside_surface_2 = Custom[Inside surface](Solid_face=flatten_3)
perimeterCurves_5 = Surface.PerimeterCurves(inside_surface_2)
byJoinedCurves_3 = PolyCurve.ByJoinedCurves(perimeterCurves_5)
code_block_39 = CodeBlock { -0.5; }
offset_upwards = Custom[Offset upwards](surface=inside_surface_2, distance=code_block_39)  # Offsets a surface upwards
perimeterCurves_6 = Surface.PerimeterCurves(offset_upwards)
byJoinedCurves_4 = PolyCurve.ByJoinedCurves(perimeterCurves_6)
create_7 = List.Create(byJoinedCurves_3, byJoinedCurves_4)
byLoft_7 = Solid.ByLoft(create_7)
explode = Geometry.Explode(byLoft_7)
flatten_24 = Flatten(explode)
area = Surface.Area(flatten_24)
code_block_40 = CodeBlock { 0; }
sortIndexByValue_2 = SortIndexByValue(area, code_block_40)
getItemAtIndex_8 = List.GetItemAtIndex(explode, sortIndexByValue_2)
code_block_41 = CodeBlock { 4; }
getItemAtIndex_9 = List.GetItemAtIndex(getItemAtIndex_8, code_block_41)
perimeterCurves_7 = Surface.PerimeterCurves(getItemAtIndex_9)
byJoinedCurves_5 = PolyCurve.ByJoinedCurves(perimeterCurves_7)
code_block_42 = CodeBlock { 0.5; }
offset_upwards_2 = Custom[Offset upwards](surface=getItemAtIndex_9, distance=code_block_42)
perimeterCurves_8 = Surface.PerimeterCurves(offset_upwards_2)
byJoinedCurves_6 = PolyCurve.ByJoinedCurves(perimeterCurves_8)
create_8 = List.Create(byJoinedCurves_5, byJoinedCurves_6)
byLoft_8 = Solid.ByLoft(create_8)
unionAll_2 = Solid.UnionAll(byLoft_7, byLoft_8)
differenceAll_6 = Solid.DifferenceAll(differenceAll_5, unionAll_2)
Light_lines = Output(differenceAll_6)
Output = Output(unionAll_2)  # ""
Output_2 = Output(flatten_3)  # ""
