# Dynamo custom node Primary light lines final.dyf (Dynamo 0.7.5.3566)
# category: Geometry.Solid.Create
# name

Pearlescent_face = Input()
outside_surface = Custom[Outside surface](Solid_face=Pearlescent_face)  # Gets outside surface from solid face
vertical_edges = Custom[Vertical edges](surface=outside_surface)  # gives a surface's vertical edges
highest_point = Custom[Highest point](curve=vertical_edges.Edge_1)  # gest curve lower point
highest_point_2 = Custom[Highest point](curve=vertical_edges.Edge_2)
byStartPointEndPoint = Line.ByStartPointEndPoint(highest_point, highest_point_2)
number_of_light_lines = Input()
code_block = CodeBlock(n=number_of_light_lines) { 0; 1; 1/(n+1); }
number_range = NumberRange(code_block.out0, code_block.out1, code_block.out2, lacing=Longest)
remove_first_last = Custom[Remove first last](list=number_range)  # removes first and last item of a list
pointAtParameter = Curve.PointAtParameter(byStartPointEndPoint, remove_first_last)
lowest_point = Custom[Lowest point](curve=vertical_edges.Edge_1)  # gest curve lower point
lowest_point_2 = Custom[Lowest point](curve=vertical_edges.Edge_2)
byStartPointEndPoint_2 = Line.ByStartPointEndPoint(lowest_point, lowest_point_2)
pointAtParameter_2 = Curve.PointAtParameter(byStartPointEndPoint_2, remove_first_last)
X = Point.X(pointAtParameter_2)
Y = Point.Y(pointAtParameter_2)
code_block_2 = CodeBlock { 20; }
byCoordinates = Point.ByCoordinates(X, Y, code_block_2)
byThreePoints = Plane.ByThreePoints(pointAtParameter, pointAtParameter_2, byCoordinates)
intersect = Geometry.Intersect(byThreePoints, outside_surface)
flatten = Flatten(intersect)
code_block_3 = CodeBlock { 1.5; }
xy_plane_at_height = Custom[XY plane at height](Height=code_block_3)  # gives a XY plane at a given height
Switch_slope = Input()
intersect_2 = Geometry.Intersect(xy_plane_at_height, vertical_edges.Edge_1)
intersect_3 = Geometry.Intersect(xy_plane_at_height, vertical_edges.Edge_2)
if_ = If(Switch_slope, intersect_2, intersect_3)
X_2 = Point.X(intersect_3)
Y_2 = Point.Y(intersect_3)
code_block_4 = CodeBlock { 20; }
byCoordinates_2 = Point.ByCoordinates(X_2, Y_2, code_block_4)
byThreePoints_2 = Plane.ByThreePoints(intersect_2, intersect_3, byCoordinates_2)
normal = Plane.Normal(byThreePoints_2)
code_block_5 = CodeBlock { 50; -50; }
if_2 = If(Switch_slope, code_block_5.out1, code_block_5.out0)
rotate = Geometry.Rotate(xy_plane_at_height, if_, normal, if_2)
intersect_4 = Geometry.Intersect(outside_surface, rotate)
flatten_2 = Flatten(intersect_4)
startPoint = Curve.StartPoint(flatten_2)
Z = Point.Z(startPoint)
code_block_6 = CodeBlock { 1; }
sortIndexByValue = SortIndexByValue(Z, code_block_6)
getItemAtIndex = List.GetItemAtIndex(flatten_2, sortIndexByValue)
code_block_7 = CodeBlock { 0; }
getItemAtIndex_2 = List.GetItemAtIndex(getItemAtIndex, code_block_7)
intersect_5 = Geometry.Intersect(flatten, getItemAtIndex_2)
code_block_8 = CodeBlock { 0.04; 0.06; }
byCenterPointRadius = Circle.ByCenterPointRadius(intersect_5, code_block_8.out0)
flatten_3 = Flatten(byCenterPointRadius)
trim = Geometry.Trim(flatten, getItemAtIndex_2, lowest_point)
byJoinedCurves = PolyCurve.ByJoinedCurves(trim)
flatten_4 = Flatten(byJoinedCurves)
bySweep = Solid.BySweep(flatten_3, flatten_4)
intersect_6 = Geometry.Intersect(bySweep, outside_surface)
code_block_9 = CodeBlock { 2*0.09; 2*0.11; }
code_block_10 = CodeBlock { 1; }
thicken = Surface.Thicken(intersect_6, code_block_9.out0, code_block_10)
flatten_5 = Flatten(thicken)
differenceAll = Solid.DifferenceAll(Pearlescent_face, flatten_5)
Trimmed_pearlescent_surface = Output(differenceAll)
byCenterPointRadius_2 = Circle.ByCenterPointRadius(intersect_5, code_block_8.out1)
flatten_6 = Flatten(byCenterPointRadius_2)
bySweep_2 = Solid.BySweep(flatten_6, flatten_4)
intersect_7 = Geometry.Intersect(bySweep_2, outside_surface)
thicken_2 = Surface.Thicken(intersect_7, code_block_9.out1, code_block_10)
differenceAll_2 = Solid.DifferenceAll(thicken_2, thicken)
inside_surface = Custom[Inside surface](Solid_face=Pearlescent_face)  # Gets outside surface from solid face
vertical_edges_2 = Custom[Vertical edges](surface=inside_surface)
highest_point_3 = Custom[Highest point](curve=vertical_edges_2.Edge_1)
highest_point_4 = Custom[Highest point](curve=vertical_edges_2.Edge_2)
create = List.Create(highest_point_3, highest_point_4, highest_point_2, highest_point)
code_block_11 = CodeBlock { 1; }
byPoints = PolyCurve.ByPoints(create, code_block_11)
byPatch = Surface.ByPatch(byPoints)
code_block_12 = CodeBlock { 0.5; }
offset_upwards = Custom[Offset upwards](surface=byPatch, distance=code_block_12)  # Offsets a surface upwards
perimeterCurves = Surface.PerimeterCurves(offset_upwards)
byJoinedCurves_2 = PolyCurve.ByJoinedCurves(perimeterCurves)
create_2 = List.Create(byJoinedCurves_2, byPoints)
byLoft = Solid.ByLoft(create_2)
differenceAll_3 = Solid.DifferenceAll(differenceAll_2, byLoft)
trim_2 = Geometry.Trim(differenceAll_3, inside_surface, highest_point)
Light_lines = Output(trim_2)
