# Dynamo custom node Primary lights.dyf (Dynamo 0.7.5.3566)
# category: Geometry.Solid.Create
# gives primary lights and trimmed pearlescent surface

pearlescent_face = Input()
switch_slope_direction = Input()
inside_surface = Custom[Inside surface](Solid_face=pearlescent_face)  # Gets outside surface from solid face
vertical_edges = Custom[Vertical edges](surface=inside_surface)  # gives a surface's vertical edges
highest_point = Custom[Highest point](curve=vertical_edges.Edge_1)  # gest curve lower point
highest_point_2 = Custom[Highest point](curve=vertical_edges.Edge_2)
line_lenth = Custom[Line + lenth](startPoint=highest_point, endPoint=highest_point_2)  # Line ans length output
number_of_primary_light_lines = Input()
code_block = CodeBlock(n=number_of_primary_light_lines)
# ---------- code_block.designscript (3 lines) ----------
//Number of light lines

n;
# ----------------------------------------
code_block_2 = CodeBlock(n=code_block) { 0; 1; 1/(n+1); }
number_range = NumberRange(code_block_2.out0, code_block_2.out1, code_block_2.out2, lacing=Longest)
remove_first_last = Custom[Remove first last](list=number_range)  # removes first and last item of a list
pointAtParameter = Curve.PointAtParameter(line_lenth.Line, remove_first_last)
lowest_point = Custom[Lowest point](curve=vertical_edges.Edge_1)  # gest curve lower point
lowest_point_2 = Custom[Lowest point](curve=vertical_edges.Edge_2)
line_lenth_2 = Custom[Line + lenth](startPoint=lowest_point, endPoint=lowest_point_2)
pointAtParameter_2 = Curve.PointAtParameter(line_lenth_2.Line, remove_first_last)
X = Point.X(pointAtParameter_2)
Y = Point.Y(pointAtParameter_2)
code_block_3 = CodeBlock { 10; }
byCoordinates = Point.ByCoordinates(X, Y, code_block_3)
byThreePoints = Plane.ByThreePoints(pointAtParameter, pointAtParameter_2, byCoordinates)
intersect = Geometry.Intersect(byThreePoints, inside_surface)
flatten = Flatten(intersect)
double_height = Input()  # "double height?"
code_block_4 = CodeBlock { 1.5; 0; }
if_ = If(double_height, code_block_4.out1, code_block_4.out0)
xy_plane_at_height = Custom[XY plane at height](Height=if_)  # gives a XY plane at a given height
intersect_2 = Geometry.Intersect(vertical_edges.Edge_1, xy_plane_at_height)
intersect_3 = Geometry.Intersect(vertical_edges.Edge_2, xy_plane_at_height)
if_2 = If(switch_slope_direction, intersect_2, intersect_3)
X_2 = Point.X(intersect_3)
Y_2 = Point.Y(intersect_3)
code_block_5 = CodeBlock { 10; }
byCoordinates_2 = Point.ByCoordinates(X_2, Y_2, code_block_5)
byThreePoints_2 = Plane.ByThreePoints(intersect_2, intersect_3, byCoordinates_2)
normal = Plane.Normal(byThreePoints_2)
code_block_6 = CodeBlock { 50; -50; 0; }
if_3 = If(switch_slope_direction, code_block_6.out1, code_block_6.out0)
if_4 = If(double_height, code_block_6.out2, if_3)
rotate = Geometry.Rotate(xy_plane_at_height, if_2, normal, if_4)
count = Count(flatten)
ofRepeatedItem = List.OfRepeatedItem(rotate, count)
flatten_2 = Flatten(ofRepeatedItem)
intersect_4 = Geometry.Intersect(flatten, flatten_2)
flatten_3 = Flatten(intersect_4)
Z = Point.Z(intersect_4)
flatten_4 = Flatten(Z)
code_block_7 = CodeBlock { 1; }
sortIndexByValue = SortIndexByValue(flatten_4, code_block_7)
getItemAtIndex = List.GetItemAtIndex(flatten_3, sortIndexByValue)
takeItems = List.TakeItems(getItemAtIndex, count)
reverse = List.Reverse(takeItems)
if_5 = If(switch_slope_direction, takeItems, reverse)
code_block_8 = CodeBlock()
# ---------- code_block_8.designscript (11 lines) ----------
//light line width

0.08;

//light line thickness

0.02;

//light line depth

0.07;
# ----------------------------------------
code_block_9 = CodeBlock(w=code_block_8.out0, th=code_block_8.out1) { w/2; w/2+th; }
byCenterPointRadius = Circle.ByCenterPointRadius(if_5, code_block_9.out0)
trim = Geometry.Trim(flatten, if_5, pointAtParameter_2)
flatten_5 = Flatten(trim)
reverse_2 = List.Reverse(flatten_5)
if_6 = If(double_height, reverse_2, flatten_5)
sweepAsSolid = Curve.SweepAsSolid(byCenterPointRadius, if_6)
intersect_5 = Geometry.Intersect(sweepAsSolid, inside_surface)
flatten_6 = Flatten(intersect_5)
code_block_10 = CodeBlock { 1; 0.2; }
thicken = Surface.Thicken(flatten_6, code_block_10.out1, code_block_10.out0)
differenceAll = Solid.DifferenceAll(pearlescent_face, thicken)
trimmed_pearlescent_surface = Output(differenceAll)
byCenterPointRadius_2 = Circle.ByCenterPointRadius(if_5, code_block_9.out1)
sweepAsSolid_2 = Curve.SweepAsSolid(byCenterPointRadius_2, if_6)
intersect_6 = Geometry.Intersect(sweepAsSolid_2, inside_surface)
flatten_7 = Flatten(intersect_6)
code_block_11 = CodeBlock(d=code_block_8.out2, th=code_block_8.out1) { 2*(d+th); }
thicken_2 = Surface.Thicken(flatten_7, code_block_11, code_block_10.out0)
code_block_12 = CodeBlock(d=code_block_8.out2) { 2*d; }
thicken_3 = Surface.Thicken(flatten_6, code_block_12, code_block_10.out0)
differenceAll_2 = Solid.DifferenceAll(thicken_2, thicken_3)
outside_surface = Custom[Outside surface](Solid_face=pearlescent_face)  # Gets outside surface from solid face
vertical_edges_2 = Custom[Vertical edges](surface=outside_surface)
highest_point_3 = Custom[Highest point](curve=vertical_edges_2.Edge_1)
highest_point_4 = Custom[Highest point](curve=vertical_edges_2.Edge_2)
create = List.Create(highest_point_3, highest_point_4, highest_point_2, highest_point)
code_block_13 = CodeBlock { 1; }
byPoints = PolyCurve.ByPoints(create, code_block_13)
byPatch = Surface.ByPatch(byPoints)
code_block_14 = CodeBlock { 0.5; }
offset_upwards = Custom[Offset upwards](surface=byPatch, distance=code_block_14)  # Offsets a surface upwards
perimeterCurves = Surface.PerimeterCurves(offset_upwards)
byJoinedCurves = PolyCurve.ByJoinedCurves(perimeterCurves)
create_2 = List.Create(byPoints, byJoinedCurves)
byLoft = Solid.ByLoft(create_2)
differenceAll_3 = Solid.DifferenceAll(differenceAll_2, byLoft)
trim_2 = Geometry.Trim(differenceAll_3, inside_surface, highest_point_3)
light_lines = Output(trim_2)
