# Dynamo custom node Proper solid Vault M3.dyf (Dynamo 0.7.5.3566)
# category: Geometry.Solid.Create
# Makes proper solid vault from vault edges

Edge_2 = Input()
Edge_1 = Input()
create = List.Create(Edge_1, Edge_2)
flatten = Flatten(create)
byLoft = Surface.ByLoft(flatten)
Vault_thickness = Input()
offset_upwards = Custom[Offset upwards](surface=byLoft, distance=Vault_thickness)  # Offsets a surface upwards
Edge_3 = Input()
create_2 = List.Create(Edge_3, Edge_2)
flatten_2 = Flatten(create_2)
byLoft_2 = Surface.ByLoft(flatten_2)
offset_upwards_2 = Custom[Offset upwards](surface=byLoft_2, distance=Vault_thickness)
intersect = Geometry.Intersect(offset_upwards, offset_upwards_2)
highest_point = Custom[Highest point](curve=Edge_2)  # gest curve lower point
highest_point_2 = Custom[Highest point](curve=intersect)
byStartPointEndPoint = Line.ByStartPointEndPoint(highest_point, highest_point_2)
lowest_point = Custom[Lowest point](curve=Edge_2)  # gest curve lower point
lowest_point_2 = Custom[Lowest point](curve=intersect)
byStartPointEndPoint_2 = Line.ByStartPointEndPoint(lowest_point, lowest_point_2)
create_3 = List.Create(Edge_2, intersect, byStartPointEndPoint, byStartPointEndPoint_2)
flatten_3 = Flatten(create_3)
byJoinedCurves = PolyCurve.ByJoinedCurves(flatten_3)
Edge_4 = Input()
create_4 = List.Create(Edge_3, Edge_4)
flatten_4 = Flatten(create_4)
byLoft_3 = Surface.ByLoft(flatten_4)
offset_upwards_3 = Custom[Offset upwards](surface=byLoft_3, distance=Vault_thickness)
intersect_2 = Geometry.Intersect(offset_upwards_2, offset_upwards_3)
highest_point_3 = Custom[Highest point](curve=Edge_3)
highest_point_4 = Custom[Highest point](curve=intersect_2)
byStartPointEndPoint_3 = Line.ByStartPointEndPoint(highest_point_3, highest_point_4)
lowest_point_3 = Custom[Lowest point](curve=Edge_3)
lowest_point_4 = Custom[Lowest point](curve=intersect_2)
byStartPointEndPoint_4 = Line.ByStartPointEndPoint(lowest_point_3, lowest_point_4)
create_5 = List.Create(Edge_3, intersect_2, byStartPointEndPoint_3, byStartPointEndPoint_4)
flatten_5 = Flatten(create_5)
byJoinedCurves_2 = PolyCurve.ByJoinedCurves(flatten_5)
create_6 = List.Create(byJoinedCurves, byJoinedCurves_2)
byLoft_4 = Solid.ByLoft(create_6)
create_7 = List.Create(Edge_4, Edge_1)
flatten_6 = Flatten(create_7)
byLoft_5 = Surface.ByLoft(flatten_6)
offset_upwards_4 = Custom[Offset upwards](surface=byLoft_5, distance=Vault_thickness)
intersect_3 = Geometry.Intersect(offset_upwards_3, offset_upwards_4)
highest_point_5 = Custom[Highest point](curve=Edge_4)
highest_point_6 = Custom[Highest point](curve=intersect_3)
byStartPointEndPoint_5 = Line.ByStartPointEndPoint(highest_point_5, highest_point_6)
lowest_point_5 = Custom[Lowest point](curve=Edge_4)
lowest_point_6 = Custom[Lowest point](curve=intersect_3)
byStartPointEndPoint_6 = Line.ByStartPointEndPoint(lowest_point_5, lowest_point_6)
create_8 = List.Create(Edge_4, intersect_3, byStartPointEndPoint_5, byStartPointEndPoint_6)
flatten_7 = Flatten(create_8)
byJoinedCurves_3 = PolyCurve.ByJoinedCurves(flatten_7)
create_9 = List.Create(byJoinedCurves_2, byJoinedCurves_3)
byLoft_6 = Solid.ByLoft(create_9)
intersect_4 = Geometry.Intersect(offset_upwards_4, offset_upwards)
highest_point_7 = Custom[Highest point](curve=Edge_1)
highest_point_8 = Custom[Highest point](curve=intersect_4)
byStartPointEndPoint_7 = Line.ByStartPointEndPoint(highest_point_7, highest_point_8)
lowest_point_7 = Custom[Lowest point](curve=Edge_1)
lowest_point_8 = Custom[Lowest point](curve=intersect_4)
byStartPointEndPoint_8 = Line.ByStartPointEndPoint(lowest_point_7, lowest_point_8)
create_10 = List.Create(Edge_1, intersect_4, byStartPointEndPoint_7, byStartPointEndPoint_8)
flatten_8 = Flatten(create_10)
byJoinedCurves_4 = PolyCurve.ByJoinedCurves(flatten_8)
create_11 = List.Create(byJoinedCurves_3, byJoinedCurves_4)
byLoft_7 = Solid.ByLoft(create_11)
create_12 = List.Create(byJoinedCurves_4, byJoinedCurves)
byLoft_8 = Solid.ByLoft(create_12)
create_13 = List.Create(byLoft_4, byLoft_6, byLoft_7, byLoft_8)
code_block = CodeBlock(x=create_13) { x[0]; x[1]; x[2]; x[3]; }
XY = Plane.XY()
intersect_5 = Geometry.Intersect(code_block.out3, XY, lacing=Longest)
flatten_9 = Flatten(intersect_5)
perimeterCurves = Surface.PerimeterCurves(flatten_9)
byJoinedCurves_5 = PolyCurve.ByJoinedCurves(perimeterCurves)
ZAxis = Vector.ZAxis()
Hauteur_partie_basse = Input()
code_block_2 = CodeBlock(x=Hauteur_partie_basse) { x<=0?0.1:-x; }
extrudeAsSolid = Curve.ExtrudeAsSolid(byJoinedCurves_5, ZAxis, code_block_2)
union = Solid.Union(extrudeAsSolid, code_block.out3)
Face_4 = Output(union)
intersect_6 = Geometry.Intersect(code_block.out2, XY, lacing=Longest)
flatten_10 = Flatten(intersect_6)
perimeterCurves_2 = Surface.PerimeterCurves(flatten_10)
byJoinedCurves_6 = PolyCurve.ByJoinedCurves(perimeterCurves_2)
extrudeAsSolid_2 = Curve.ExtrudeAsSolid(byJoinedCurves_6, ZAxis, code_block_2)
union_2 = Solid.Union(extrudeAsSolid_2, code_block.out2)
Face_3 = Output(union_2)
intersect_7 = Geometry.Intersect(code_block.out1, XY, lacing=Longest)
flatten_11 = Flatten(intersect_7)
perimeterCurves_3 = Surface.PerimeterCurves(flatten_11)
byJoinedCurves_7 = PolyCurve.ByJoinedCurves(perimeterCurves_3)
extrudeAsSolid_3 = Curve.ExtrudeAsSolid(byJoinedCurves_7, ZAxis, code_block_2)
union_3 = Solid.Union(extrudeAsSolid_3, code_block.out1)
Face_2 = Output(union_3)
intersect_8 = Geometry.Intersect(code_block.out0, XY, lacing=Longest)
flatten_12 = Flatten(intersect_8)
perimeterCurves_4 = Surface.PerimeterCurves(flatten_12)
byJoinedCurves_8 = PolyCurve.ByJoinedCurves(perimeterCurves_4)
extrudeAsSolid_4 = Curve.ExtrudeAsSolid(byJoinedCurves_8, ZAxis, code_block_2)
union_4 = Solid.Union(extrudeAsSolid_4, code_block.out0)
Face_1 = Output(union_4)
