# Dynamo custom node Proper solid vault 2 .dyf "Proper solid vault 2" (Dynamo 0.7.5.3566)
# category: Geometry.Solid.Create
# other means

index0 = Input()
index1 = Input()
create = List.Create(index0, index1)
flatten = Flatten(create)
byLoft = Surface.ByLoft(flatten)
code_block = CodeBlock { 0.03; }
offset_upwards = Custom[Offset upwards](surface=byLoft, distance=code_block)  # Offsets a surface upwards
index1_2 = Input(index1)
create_2 = List.Create(index1, index1_2)
flatten_2 = Flatten(create_2)
byLoft_2 = Surface.ByLoft(flatten_2)
offset_upwards_2 = Custom[Offset upwards](surface=byLoft_2, distance=code_block)
intersectAll = Geometry.IntersectAll(offset_upwards, offset_upwards_2)
highest_point = Custom[Highest point](curve=intersectAll)  # gest curve lower point
index1_3 = Input(index1)
create_3 = List.Create(index1_2, index1_3)
flatten_3 = Flatten(create_3)
byLoft_3 = Surface.ByLoft(flatten_3)
offset_upwards_3 = Custom[Offset upwards](surface=byLoft_3, distance=code_block)
intersectAll_2 = Geometry.IntersectAll(offset_upwards_2, offset_upwards_3)
highest_point_2 = Custom[Highest point](curve=intersectAll_2)
byStartPointEndPoint = Line.ByStartPointEndPoint(highest_point, highest_point_2)
lowest_point = Custom[Lowest point](curve=intersectAll)  # gest curve lower point
lowest_point_2 = Custom[Lowest point](curve=intersectAll_2)
byStartPointEndPoint_2 = Line.ByStartPointEndPoint(lowest_point, lowest_point_2)
create_4 = List.Create(byStartPointEndPoint, intersectAll, intersectAll_2, byStartPointEndPoint_2)
flatten_4 = Flatten(create_4)
byJoinedCurves = PolyCurve.ByJoinedCurves(flatten_4)
perimeterCurves = Surface.PerimeterCurves(byLoft_2)
byJoinedCurves_2 = PolyCurve.ByJoinedCurves(perimeterCurves)
create_5 = List.Create(byJoinedCurves, byJoinedCurves_2)
byLoft_4 = Solid.ByLoft(create_5)
create_6 = List.Create(index0, index1_3)
flatten_5 = Flatten(create_6)
byLoft_5 = Surface.ByLoft(flatten_5)
offset_upwards_4 = Custom[Offset upwards](surface=byLoft_5, distance=code_block)
intersectAll_3 = Geometry.IntersectAll(offset_upwards_3, offset_upwards_4)
highest_point_3 = Custom[Highest point](curve=intersectAll_3)
byStartPointEndPoint_3 = Line.ByStartPointEndPoint(highest_point_2, highest_point_3)
lowest_point_3 = Custom[Lowest point](curve=intersectAll_3)
byStartPointEndPoint_4 = Line.ByStartPointEndPoint(lowest_point_2, lowest_point_3)
create_7 = List.Create(byStartPointEndPoint_3, intersectAll_2, byStartPointEndPoint_4, intersectAll_3)
flatten_6 = Flatten(create_7)
byJoinedCurves_3 = PolyCurve.ByJoinedCurves(flatten_6)
perimeterCurves_2 = Surface.PerimeterCurves(byLoft_3)
byJoinedCurves_4 = PolyCurve.ByJoinedCurves(perimeterCurves_2)
create_8 = List.Create(byJoinedCurves_3, byJoinedCurves_4)
byLoft_6 = Solid.ByLoft(create_8)
intersectAll_4 = Geometry.IntersectAll(offset_upwards, offset_upwards_4)
highest_point_4 = Custom[Highest point](curve=intersectAll_4)
byStartPointEndPoint_5 = Line.ByStartPointEndPoint(highest_point_3, highest_point_4)
lowest_point_4 = Custom[Lowest point](curve=intersectAll_4)
byStartPointEndPoint_6 = Line.ByStartPointEndPoint(lowest_point_3, lowest_point_4)
create_9 = List.Create(byStartPointEndPoint_5, intersectAll_3, byStartPointEndPoint_6, intersectAll_4)
flatten_7 = Flatten(create_9)
byJoinedCurves_5 = PolyCurve.ByJoinedCurves(flatten_7)
perimeterCurves_3 = Surface.PerimeterCurves(byLoft_5)
byJoinedCurves_6 = PolyCurve.ByJoinedCurves(perimeterCurves_3)
create_10 = List.Create(byJoinedCurves_5, byJoinedCurves_6)
byLoft_7 = Solid.ByLoft(create_10)
byStartPointEndPoint_7 = Line.ByStartPointEndPoint(highest_point, highest_point_4)
byStartPointEndPoint_8 = Line.ByStartPointEndPoint(lowest_point, lowest_point_4)
create_11 = List.Create(byStartPointEndPoint_7, intersectAll_4, byStartPointEndPoint_8, intersectAll)
flatten_8 = Flatten(create_11)
byJoinedCurves_7 = PolyCurve.ByJoinedCurves(flatten_8)
perimeterCurves_4 = Surface.PerimeterCurves(byLoft)
byJoinedCurves_8 = PolyCurve.ByJoinedCurves(perimeterCurves_4)
create_12 = List.Create(byJoinedCurves_7, byJoinedCurves_8)
byLoft_8 = Solid.ByLoft(create_12)
create_13 = List.Create(byLoft_4, byLoft_6, byLoft_7, byLoft_8)
list = Output(create_13)
