# Dynamo custom node Remove first last.dyf (Dynamo 0.7.5.3566)
# category: Core.List.Actions
# removes first and last item of a list

list = Input()
count = Count(list)
code_block = CodeBlock(n=count) { 0; (n-1); }
create = List.Create(code_block.out0, code_block.out1)
removeItemAtIndex = List.RemoveItemAtIndex(list, create)
list_2 = Output(removeItemAtIndex)  # "list"
