# Dynamo custom node SAT to RFA M3.dyf (Dynamo 0.7.5.3566)
# category: Geometry.Solid.Actions
# SAT to RFA M3

geometry = Input()
explode = Geometry.Explode(geometry)
code_block = CodeBlock(x=explode) { x[1]; }
perimeterCurves = Surface.PerimeterCurves(code_block)
code_block_2 = CodeBlock { 1; }
getItemAtIndex = List.GetItemAtIndex(perimeterCurves, code_block_2)
getItemAtIndex_2 = List.GetItemAtIndex(getItemAtIndex, code_block_2)
startPoint = Curve.StartPoint(getItemAtIndex_2)
byCoordinates = Point.ByCoordinates()
byTwoPoints = Vector.ByTwoPoints(startPoint, byCoordinates)
translate = Geometry.Translate(geometry, byTwoPoints)
Geometry = Output(translate)
