# Dynamo custom node Solid vault partie basse.dyf (Dynamo 0.7.5.3566)
# category: Geometry.Solid.Create
# gives lower part of vault

XY = Plane.XY()
Proper_solid_vault = Input()
intersect = Geometry.Intersect(XY, Proper_solid_vault)
perimeterCurves = Surface.PerimeterCurves(intersect)
byJoinedCurves = PolyCurve.ByJoinedCurves(perimeterCurves)
flatten = Flatten(byJoinedCurves)
lower_part_height = Input()
code_block = CodeBlock(x=lower_part_height) { -x; }
translate = Geometry.Translate(flatten, arg3=code_block)
create = List.Create(flatten, translate)
flatten_2 = Flatten(create)
code_block_2 = CodeBlock { 4; }
code_block_3 = CodeBlock(n=code_block_2) { 1; n; }
number_range = NumberRange(code_block_3.out0, code_block_3.n, code_block_3.out0, lacing=Longest)
takeEveryNthItem = List.TakeEveryNthItem(flatten_2, code_block_2, number_range)
byLoft = Solid.ByLoft(takeEveryNthItem)
Vault_lower_part = Output(byLoft)
