# Dynamo custom node Sort curves.dyf (Dynamo 0.7.5.3566)
# category: Geometry.Curve.Actions
# sorts a range of curve by distance

list = Input()
code_block = CodeBlock { 0; }
getItemAtIndex = List.GetItemAtIndex(list, code_block)
flatten = Flatten(list)
count = Count(flatten)
code_block_2 = CodeBlock(n=count) { 1..(n-1); }
getItemAtIndex_2 = List.GetItemAtIndex(flatten, code_block_2)
flatten_2 = Flatten(getItemAtIndex_2)
code_block_3 = CodeBlock(n=count) { n-1; }
ofRepeatedItem = List.OfRepeatedItem(flatten_2, code_block_3)
flatten_3 = Flatten(ofRepeatedItem)
highest_lowest_points = Custom[Highest.lowest points](curve=getItemAtIndex_2)  # gives curves highest and lowest points
flatten_4 = Flatten(highest_lowest_points.Highest)
cycle = List.Cycle(flatten_4, code_block_3)
highest_lowest_points_2 = Custom[Highest.lowest points](curve=getItemAtIndex)
flatten_5 = Flatten(highest_lowest_points_2.Highest)
count_2 = Count(cycle)
ofRepeatedItem_2 = List.OfRepeatedItem(flatten_5, count_2)
flatten_6 = Flatten(ofRepeatedItem_2)
distanceTo = Geometry.DistanceTo(cycle, flatten_6)
code_block_4 = CodeBlock { 1; }
sortIndexByValue = SortIndexByValue(distanceTo, code_block_4)
getItemAtIndex_3 = List.GetItemAtIndex(cycle, sortIndexByValue)
chop = List.Chop(getItemAtIndex_3, code_block_3)
doesIntersect = Geometry.DoesIntersect(chop, ofRepeatedItem)
flatten_7 = Flatten(doesIntersect)
filterByBoolMask = List.FilterByBoolMask(flatten_3, flatten_7)
create = List.Create(getItemAtIndex, filterByBoolMask)
flatten_8 = Flatten(create)
Sorted_curves = Output(flatten_8)
