# Dynamo custom node Vertical edges.dyf (Dynamo 0.7.5.3566)
# category: Geometry.Surface.Query
# gives a surface's vertical edges

surface = Input()
perimeterCurves = Surface.PerimeterCurves(surface)
code_block = CodeBlock { 0; 2; }
getItemAtIndex = List.GetItemAtIndex(perimeterCurves, code_block.out0)
Edge_1 = Output(getItemAtIndex)
getItemAtIndex_2 = List.GetItemAtIndex(perimeterCurves, code_block.out1)
Edge_2 = Output(getItemAtIndex_2)
