# Dynamo custom node corian plaster separation M2.dyf (Dynamo 0.7.5.3566)
# category: Geometry.Curve.Create
# give separation as model curve

Edge_with_corian_high_point = Input()
geometry = Element.Geometry(Edge_with_corian_high_point)
controlPoints = NurbsCurve.ControlPoints(geometry)
flatten = Flatten(controlPoints)
code_block = CodeBlock(x=flatten) { x[1]; x[2]; }
byStartPointEndPoint = Line.ByStartPointEndPoint(code_block.out0, code_block.out1)
code_block_2 = CodeBlock { 0.5; }
pointAtParameter = Curve.PointAtParameter(byStartPointEndPoint, code_block_2)
code_block_3 = CodeBlock(x=flatten) { x[3]; x[2]; }
byStartPointEndPoint_2 = Line.ByStartPointEndPoint(code_block_3.out0, code_block_3.out1)
pointAtParameter_2 = Curve.PointAtParameter(byStartPointEndPoint_2, code_block_2)
byStartPointEndPoint_3 = Line.ByStartPointEndPoint(pointAtParameter, pointAtParameter_2)
intersect = Geometry.Intersect(byStartPointEndPoint_3, geometry)
flatten_2 = Flatten(intersect)
highest_point = Custom[Highest point](curve=geometry)  # gest curve lower point
code_block_4 = CodeBlock { 1.5; }
xy_plane_at_height = Custom[XY plane at height](Height=code_block_4)  # gives a XY plane at a given height
Edge_with_corian_low_point = Input()
geometry_2 = Element.Geometry(Edge_with_corian_low_point)
intersect_2 = Geometry.Intersect(xy_plane_at_height, geometry_2)
flatten_3 = Flatten(intersect_2)
byThreePoints = Plane.ByThreePoints(flatten_2, highest_point, flatten_3)
create = List.Create(geometry_2, geometry)
flatten_4 = Flatten(create)
byLoft = Surface.ByLoft(flatten_4)
intersect_3 = Geometry.Intersect(byThreePoints, byLoft)
flatten_5 = Flatten(intersect_3)
setDifference = SetDifference(flatten_5, highest_point)
Curve_1 = Output(setDifference)
Edge_with_corian_high_point_2 = Input(Edge with corian high point)
geometry_3 = Element.Geometry(Edge_with_corian_high_point_2)
controlPoints_2 = NurbsCurve.ControlPoints(geometry_3)
flatten_6 = Flatten(controlPoints_2)
code_block_5 = CodeBlock(x=flatten_6) { x[1]; x[2]; }
byStartPointEndPoint_4 = Line.ByStartPointEndPoint(code_block_5.out0, code_block_5.out1)
code_block_6 = CodeBlock { 0.5; }
pointAtParameter_3 = Curve.PointAtParameter(byStartPointEndPoint_4, code_block_6)
code_block_7 = CodeBlock(x=flatten_6) { x[3]; x[2]; }
byStartPointEndPoint_5 = Line.ByStartPointEndPoint(code_block_7.out0, code_block_7.out1)
pointAtParameter_4 = Curve.PointAtParameter(byStartPointEndPoint_5, code_block_6)
byStartPointEndPoint_6 = Line.ByStartPointEndPoint(pointAtParameter_3, pointAtParameter_4)
intersect_4 = Geometry.Intersect(byStartPointEndPoint_6, geometry_3)
flatten_7 = Flatten(intersect_4)
highest_point_2 = Custom[Highest point](curve=geometry_3)
byThreePoints_2 = Plane.ByThreePoints(flatten_7, flatten_3, highest_point_2)
create_2 = List.Create(geometry_2, geometry_3)
flatten_8 = Flatten(create_2)
byLoft_2 = Surface.ByLoft(flatten_8)
intersect_5 = Geometry.Intersect(byThreePoints_2, byLoft_2)
flatten_9 = Flatten(intersect_5)
setDifference_2 = SetDifference(flatten_9, highest_point_2)
Curve_2 = Output(setDifference_2)
