# Dynamo custom node downlight spline.dyf (Dynamo 0.7.5.3566)
# category: Geometry.Cuboid.Create
# spline from 2d guideline

curve = Input()
test = Input()
curve_reverse = Custom[CURVE REVERSE](curve=curve, test=test)  # REVERSES CURVE
X = Point.X(curve_reverse.curve_end_1)
Y = Point.Y(curve_reverse.curve_end_1)
h = Input()
code_block = CodeBlock(h=h) { 0.255*h; 0.861*h; 0.963*h; h; }
byCoordinates = Point.ByCoordinates(X, Y, code_block.out0)
byCoordinates_2 = Point.ByCoordinates(X, Y, code_block.out1)
X_2 = Point.X(curve_reverse.curve_2)
Y_2 = Point.Y(curve_reverse.curve_2)
byCoordinates_3 = Point.ByCoordinates(X_2, Y_2, code_block.out2)
byCoordinates_4 = Point.ByCoordinates(X, Y, code_block.out2)
byStartPointEndPoint = Line.ByStartPointEndPoint(byCoordinates_3, byCoordinates_4)
pointAtDistance = Curve.PointAtDistance(byStartPointEndPoint, code_block.h)
byCoordinates_5 = Point.ByCoordinates(X_2, Y_2, code_block.h)
create = List.Create(curve_reverse.curve_end_1, byCoordinates, byCoordinates_2, pointAtDistance, byCoordinates_5)
flatten = Flatten(create)
byControlPoints = NurbsCurve.ByControlPoints(flatten)
NurbsCurve = Output(byControlPoints)
