# Dynamo custom node higherlower point from revit curve.dyf (Dynamo 0.7.5.3566)
# category: Geometry.Curve.Actions
# gets higher and lower point of a curve

Curve = Input()
curve = CurveElement.Curve(Curve)
endPoint = Curve.EndPoint(curve)
Z = Point.Z(endPoint)
startPoint = Curve.StartPoint(curve)
Z_2 = Point.Z(startPoint)
code_block = CodeBlock(a=Z, b=Z_2) { a>b; }
if_ = If(code_block, endPoint, startPoint)
Higher_point = Output(if_)
if_2 = If(code_block, startPoint, endPoint)
Lower_point = Output(if_2)
