# Dynamo custom node higherlower point.dyf (Dynamo 0.7.5.3566)
# category: Geometry.Curve.Actions
# gets higher and lower point of a curve

Curve = Input()
endPoint = Curve.EndPoint(Curve)
flatten = Flatten(endPoint)
Z = Point.Z(flatten)
startPoint = Curve.StartPoint(Curve)
flatten_2 = Flatten(startPoint)
Z_2 = Point.Z(flatten_2)
code_block = CodeBlock(a=Z, b=Z_2) { a>b; }
if_ = If(code_block, endPoint, startPoint)
code_block_2 = CodeBlock { 0; }
getItemAtIndex = List.GetItemAtIndex(if_, code_block_2)
uniqueItems = List.UniqueItems(getItemAtIndex)
Higher_point = Output(uniqueItems)
if_2 = If(code_block, startPoint, endPoint)
getItemAtIndex_2 = List.GetItemAtIndex(if_2, code_block_2)
uniqueItems_2 = List.UniqueItems(getItemAtIndex_2)
Lower_point = Output(uniqueItems_2)
