# Dynamo custom node light line geometry  fatality.dyf "light line geometry fatality" (Dynamo 0.7.5.3566)
# category: Geometry.Curve.Create
# light line geometry

curve = Input()
highest_point = Custom[Highest point](curve=curve)  # gest curve lower point
curve_2 = Input(curve)
highest_point_2 = Custom[Highest point](curve=curve_2)
byStartPointEndPoint = Line.ByStartPointEndPoint(highest_point, highest_point_2)
n = Input()
code_block = CodeBlock(n=n) { 0..1..1/(n+1); }
remove_first_last = Custom[Remove first last](list=code_block)  # removes first and last item of a list
pointAtParameter = Curve.PointAtParameter(byStartPointEndPoint, remove_first_last)
lowest_point = Custom[Lowest point](curve=curve)  # gest curve lower point
lowest_point_2 = Custom[Lowest point](curve=curve_2)
byStartPointEndPoint_2 = Line.ByStartPointEndPoint(lowest_point, lowest_point_2)
pointAtParameter_2 = Curve.PointAtParameter(byStartPointEndPoint_2, remove_first_last)
code_block_2 = CodeBlock(p=pointAtParameter_2) { p.X; p.Y; 5; }
byCoordinates = Point.ByCoordinates(code_block_2.out0, code_block_2.out1, code_block_2.out2)
byThreePoints = Plane.ByThreePoints(pointAtParameter, pointAtParameter_2, byCoordinates)
entity = Input()
intersect = Geometry.Intersect(byThreePoints, entity)
normal = Plane.Normal(byThreePoints)
w = Input()
code_block_3 = CodeBlock(w=w) { w/2; -w/2; }
translate = Geometry.Translate(byThreePoints, normal, code_block_3.out0)
intersect_2 = Geometry.Intersect(translate, entity)
translate_2 = Geometry.Translate(byThreePoints, normal, code_block_3.out1)
intersect_3 = Geometry.Intersect(translate_2, entity)
Line = Output(byStartPointEndPoint)
Line_2 = Output(byStartPointEndPoint_2)  # "Line"
Plane = Output(byThreePoints)
