# Dynamo custom node light lines wireframe.dyf (Dynamo 0.7.5.3566)
# category: Geometry.Cuboid.Create
# gives light line wireframes

surface_edge_1 = Input()
parameters = Input()
Light_line_width = Input()
length = Curve.Length(surface_edge_1)
code_block = CodeBlock(a=parameters, lw=Light_line_width, l=length) { a+(lw/2)/l; a-(lw/2)/l; }
remove_first_last = Custom[Remove first last](list=code_block.out0)  # removes first and last item of a list
pointAtParameter = Curve.PointAtParameter(surface_edge_1, remove_first_last)
surface_edge_2 = Input()
length_2 = Curve.Length(surface_edge_2)
code_block_2 = CodeBlock(a=parameters, lw=Light_line_width, l=length_2) { a+(lw/2)/l; a-(lw/2)/l; }
remove_first_last_2 = Custom[Remove first last](list=code_block_2.out0)
pointAtParameter_2 = Curve.PointAtParameter(surface_edge_2, remove_first_last_2)
X = Point.X(pointAtParameter_2)
Y = Point.Y(pointAtParameter_2)
code_block_3 = CodeBlock { 4; }
byCoordinates = Point.ByCoordinates(X, Y, code_block_3)
byThreePoints = Plane.ByThreePoints(pointAtParameter, pointAtParameter_2, byCoordinates)
surface = Input()
intersect = Geometry.Intersect(byThreePoints, surface)
Geometry = Output(intersect)  # "Geometry[]"
remove_first_last_3 = Custom[Remove first last](list=code_block.out1)
pointAtParameter_3 = Curve.PointAtParameter(surface_edge_1, remove_first_last_3)
remove_first_last_4 = Custom[Remove first last](list=code_block_2.out1)
pointAtParameter_4 = Curve.PointAtParameter(surface_edge_2, remove_first_last_4)
X_2 = Point.X(pointAtParameter_4)
Y_2 = Point.Y(pointAtParameter_4)
code_block_4 = CodeBlock { 4; }
byCoordinates_2 = Point.ByCoordinates(X_2, Y_2, code_block_4)
byThreePoints_2 = Plane.ByThreePoints(pointAtParameter_3, pointAtParameter_4, byCoordinates_2)
intersect_2 = Geometry.Intersect(byThreePoints_2, surface)
Geometry_2 = Output(intersect_2)  # "Geometry[]"
