# Dynamo custom node list halfing.dyf (Dynamo 0.7.5.3566)
# category: Core.List.Actions
# gives first half and last half of a list

list = Input()
count = Count(list)
code_block = CodeBlock(n=count) { n/2; }
takeItems = List.TakeItems(list, code_block)
n1st_half = Output(takeItems)  # "1st half"
dropItems = List.DropItems(list, code_block)
n2nd_half = Output(dropItems)  # "2nd half"
