# Dynamo custom node lower parti light lines.dyf (Dynamo 0.7.5.3566)
# category: Geometry.Solid.Create
# name

Pearlescent_surface = Input()
outside_surface = Custom[Outside surface](Solid_face=Pearlescent_surface)  # Gets outside surface from solid face
perimeterCurves = Surface.PerimeterCurves(outside_surface)
length = Curve.Length(perimeterCurves)
code_block = CodeBlock { 0; }
sortIndexByValue = SortIndexByValue(length, code_block)
getItemAtIndex = List.GetItemAtIndex(perimeterCurves, sortIndexByValue)
code_block_2 = CodeBlock { 0; 1; }
getItemAtIndex_2 = List.GetItemAtIndex(getItemAtIndex, code_block_2.out0)
lowest_point = Custom[Lowest point](curve=getItemAtIndex_2)  # gest curve lower point
getItemAtIndex_3 = List.GetItemAtIndex(getItemAtIndex, code_block_2.out1)
lowest_point_2 = Custom[Lowest point](curve=getItemAtIndex_3)
byStartPointEndPoint = Line.ByStartPointEndPoint(lowest_point, lowest_point_2)
number_of_ligtht_lines = Input()
code_block_3 = CodeBlock(n=number_of_ligtht_lines) { 0; 1; 1/(n+1); }
number_range = NumberRange(code_block_3.out0, code_block_3.out1, code_block_3.out2, lacing=Longest)
remove_first_last = Custom[Remove first last](list=number_range)  # removes first and last item of a list
pointAtParameter = Curve.PointAtParameter(byStartPointEndPoint, remove_first_last)
code_block_4 = CodeBlock { 0.04; 0.06; }
byCenterPointRadius = Circle.ByCenterPointRadius(pointAtParameter, code_block_4.out0)
highest_point = Custom[Highest point](curve=getItemAtIndex_2)  # gest curve lower point
highest_point_2 = Custom[Highest point](curve=getItemAtIndex_3)
byStartPointEndPoint_2 = Line.ByStartPointEndPoint(highest_point, highest_point_2)
pointAtParameter_2 = Curve.PointAtParameter(byStartPointEndPoint_2, remove_first_last)
byStartPointEndPoint_3 = Line.ByStartPointEndPoint(pointAtParameter_2, pointAtParameter)
sweepAsSolid = Curve.SweepAsSolid(byCenterPointRadius, byStartPointEndPoint_3)
intersect = Geometry.Intersect(sweepAsSolid, outside_surface)
flatten = Flatten(intersect)
start_point_hight = Input()
xy_plane_at_height = Custom[XY plane at height](Height=start_point_hight)  # gives a XY plane at a given height
switch_slope_direction = Input()
intersect_2 = Geometry.Intersect(getItemAtIndex_2, xy_plane_at_height)
intersect_3 = Geometry.Intersect(getItemAtIndex_3, xy_plane_at_height)
if_ = If(switch_slope_direction, intersect_2, intersect_3)
X = Point.X(intersect_3)
Y = Point.Y(intersect_3)
code_block_5 = CodeBlock { -20; }
byCoordinates = Point.ByCoordinates(X, Y, code_block_5)
byThreePoints = Plane.ByThreePoints(intersect_2, intersect_3, byCoordinates)
normal = Plane.Normal(byThreePoints)
code_block_6 = CodeBlock { 50; -50; }
if_2 = If(switch_slope_direction, code_block_6.out0, code_block_6.out1)
rotate = Geometry.Rotate(xy_plane_at_height, if_, normal, if_2)
cycle = List.Cycle(rotate, number_of_ligtht_lines)
intersect_4 = Geometry.Intersect(byStartPointEndPoint_3, cycle)
flatten_2 = Flatten(intersect_4)
Z = Point.Z(flatten_2)
xy_plane_at_height_2 = Custom[XY plane at height](Height=Z)
trim = Geometry.Trim(flatten, xy_plane_at_height_2, pointAtParameter)
flatten_3 = Flatten(trim)
code_block_7 = CodeBlock { 0.08*2; (0.08+0.02)*2; }
code_block_8 = CodeBlock { 1; }
thicken = Surface.Thicken(flatten_3, code_block_7.out0, code_block_8)
differenceAll = Solid.DifferenceAll(Pearlescent_surface, thicken)
Trimmed_pearlescent_surface = Output(differenceAll)
byCenterPointRadius_2 = Circle.ByCenterPointRadius(pointAtParameter, code_block_4.out1)
sweepAsSolid_2 = Curve.SweepAsSolid(byCenterPointRadius_2, byStartPointEndPoint_3)
intersect_5 = Geometry.Intersect(sweepAsSolid_2, outside_surface)
flatten_4 = Flatten(intersect_5)
trim_2 = Geometry.Trim(flatten_4, xy_plane_at_height_2, pointAtParameter)
flatten_5 = Flatten(trim_2)
thicken_2 = Surface.Thicken(flatten_5, code_block_7.out1, code_block_8)
differenceAll_2 = Solid.DifferenceAll(thicken_2, thicken)
inside_surface = Custom[Inside surface](Solid_face=Pearlescent_surface)  # Gets outside surface from solid face
lowest_point_3 = Custom[Lowest point](curve=getItemAtIndex_2)
trim_3 = Geometry.Trim(differenceAll_2, inside_surface, lowest_point_3)
light_lines = Output(trim_3)
