# Dynamo custom node lowest n points.dyf (Dynamo 0.7.5.3566)
# category: Geometry.Curve.Query
# gets n points from a list with lowest value fo z

point = Input()
flatten = Flatten(point)
Z = Point.Z(point)
flatten_2 = Flatten(Z)
sort = List.Sort(flatten_2)
index = Input()
getItemAtIndex = List.GetItemAtIndex(sort, index)
code_block = CodeBlock(a=flatten_2, b=getItemAtIndex) { a>b; }
filterByBoolMask = List.FilterByBoolMask(flatten, code_block)
code_block_2 = CodeBlock { 1; }
chop = List.Chop(filterByBoolMask.out1, code_block_2)
output = Output(chop)  # "[]"
