# Dynamo custom node socle.dyf (Dynamo 0.7.5.3566)
# category: Geometry.Solid.Create
# vault socle

geometry_to_trim = Input()
a = Input()
code_block = CodeBlock(a=a) { -a+0.175; -a; }
xy_plane_at_height = Custom[XY plane at height](Height=code_block.out0)  # gives a XY plane at a given height
byCoordinates = Point.ByCoordinates(arg2=code_block.out1)
trim = Geometry.Trim(geometry_to_trim, xy_plane_at_height, byCoordinates)
Geometry = Output(trim)  # "Geometry[]"
edge1 = Input()
lowest_point = Custom[Lowest point](curve=edge1)  # gest curve lower point
edge2 = Input()
lowest_point_2 = Custom[Lowest point](curve=edge2)
edge3 = Input()
lowest_point_3 = Custom[Lowest point](curve=edge3)
edge4 = Input()
lowest_point_4 = Custom[Lowest point](curve=edge4)
create = List.Create(lowest_point, lowest_point_2, lowest_point_3, lowest_point_4)
code_block_2 = CodeBlock { 1; }
byPoints = PolyCurve.ByPoints(create, code_block_2)
translate = Geometry.Translate(byPoints, arg3=code_block.out0)
translate_2 = Geometry.Translate(create, arg3=code_block.out0)
code_block_3 = CodeBlock { 0; 1; 2; 3; }
getItemAtIndex = List.GetItemAtIndex(translate_2, code_block_3.out0)
getItemAtIndex_2 = List.GetItemAtIndex(translate_2, code_block_3.out2)
byStartPointEndPoint = Line.ByStartPointEndPoint(getItemAtIndex, getItemAtIndex_2)
getItemAtIndex_3 = List.GetItemAtIndex(translate_2, code_block_3.out1)
getItemAtIndex_4 = List.GetItemAtIndex(translate_2, code_block_3.out3)
byStartPointEndPoint_2 = Line.ByStartPointEndPoint(getItemAtIndex_3, getItemAtIndex_4)
intersect = Geometry.Intersect(byStartPointEndPoint, byStartPointEndPoint_2)
code_block_4 = CodeBlock { 0.95; }
pointAtParameter = Curve.PointAtParameter(byStartPointEndPoint, code_block_4)
scale = Geometry.Scale(translate, intersect, getItemAtIndex, pointAtParameter)
code_block_5 = CodeBlock { -0.125; -0.05; }
translate_3 = Geometry.Translate(scale, arg3=code_block_5.out0)
create_2 = List.Create(translate, translate_3)
flatten = Flatten(create_2)
byLoft = Solid.ByLoft(flatten)
translate_4 = Geometry.Translate(translate_3, arg3=code_block_5.out1)
create_3 = List.Create(translate_3, translate_4)
flatten_2 = Flatten(create_3)
byLoft_2 = Solid.ByLoft(flatten_2)
create_4 = List.Create(byLoft, byLoft_2)
list = Output(create_4)
