# Dynamo custom node structure downlight.dyf (Dynamo 0.7.5.3566)
# category: Geometry.Cylinder.Query
# structure from guidelines

code_block = CodeBlock { 0.1; }
xy_plane_at_height = Custom[XY plane at height](Height=code_block)  # gives a XY plane at a given height
edge_1 = Input()
Edge_2 = Input()
Edge_3 = Input()
Edge_4 = Input()
create = List.Create(edge_1, Edge_2, Edge_3, Edge_4)
flatten = Flatten(create)
code_block_2 = CodeBlock { 0.5; }
normalAtParameter = Curve.NormalAtParameter(flatten, code_block_2)
Z = Vector.Z(normalAtParameter)
code_block_3 = CodeBlock(z=Z) { z>=0; }
code_block_4 = CodeBlock { 0.05; -0.05; }
if_ = If(code_block_3, code_block_4.out0, code_block_4.out1)
offset = Curve.Offset(flatten, if_)
intersect = Geometry.Intersect(xy_plane_at_height, offset, lacing=CrossProduct)
flatten_2 = Flatten(intersect)
code_block_5 = CodeBlock { 1; }
byPoints = PolyCurve.ByPoints(flatten_2, code_block_5)
curves = PolyCurve.Curves(byPoints)
code_block_6 = CodeBlock { 0.1; -0.1; }
if_2 = If(code_block_3, code_block_6.out0, code_block_6.out1)
offset_2 = Curve.Offset(flatten, if_2)
intersect_2 = Geometry.Intersect(xy_plane_at_height, offset_2, lacing=CrossProduct)
flatten_3 = Flatten(intersect_2)
code_block_7 = CodeBlock { 1; }
byPoints_2 = PolyCurve.ByPoints(flatten_3, code_block_7)
curves_2 = PolyCurve.Curves(byPoints_2)
create_2 = List.Create(curves, curves_2)
transpose = List.Transpose(create_2)
byLoft = Surface.ByLoft(transpose)
code_block_8 = CodeBlock { 0.04; 1; }
thicken = Surface.Thicken(byLoft, code_block_8.out0, code_block_8.out1)
code_block_9 = CodeBlock { 0.45; }
xy_plane_at_height_2 = Custom[XY plane at height](Height=code_block_9)
intersect_3 = Geometry.Intersect(xy_plane_at_height_2, offset, lacing=CrossProduct)
flatten_4 = Flatten(intersect_3)
code_block_10 = CodeBlock { 1; }
byPoints_3 = PolyCurve.ByPoints(flatten_4, code_block_10)
ZAxis = Vector.ZAxis()
code_block_11 = CodeBlock { 0.05; }
extrude = Curve.Extrude(byPoints_3, ZAxis, code_block_11)
thicken_2 = Surface.Thicken(extrude, code_block_8.out0, code_block_8.out1)
startPoint = Curve.StartPoint(flatten)
code_block_12 = CodeBlock { 1; }
byPoints_4 = PolyCurve.ByPoints(startPoint, code_block_12)
curves_3 = PolyCurve.Curves(byPoints_4)
code_block_13 = CodeBlock { 0.5; }
pointAtParameter = Curve.PointAtParameter(curves_3, code_block_13)
X = Point.X(pointAtParameter)
Y = Point.Y(pointAtParameter)
code_block_14 = CodeBlock { 10; }
byCoordinates = Point.ByCoordinates(X, Y, code_block_14)
endPoint = Curve.EndPoint(flatten)
code_block_15 = CodeBlock { 1; }
byPoints_5 = PolyCurve.ByPoints(endPoint, code_block_15)
curves_4 = PolyCurve.Curves(byPoints_5)
pointAtParameter_2 = Curve.PointAtParameter(curves_4, code_block_13)
byThreePoints = Plane.ByThreePoints(pointAtParameter, byCoordinates, pointAtParameter_2)
Surface_M1 = Input()
intersect_4 = Geometry.Intersect(byThreePoints, Surface_M1)
flatten_5 = Flatten(intersect_4)
code_block_16 = CodeBlock { 0.5; }
normalAtParameter_2 = Curve.NormalAtParameter(flatten_5, code_block_16)
Z_2 = Vector.Z(normalAtParameter_2)
code_block_17 = CodeBlock(z=Z_2) { z>=0; }
code_block_18 = CodeBlock { 0.04; -0.04; }
if_3 = If(code_block_17, code_block_18.out0, code_block_18.out1)
offset_3 = Curve.Offset(flatten_5, if_3)
code_block_19 = CodeBlock { 0.1; -0.1; }
if_4 = If(code_block_17, code_block_19.out0, code_block_19.out1)
offset_4 = Curve.Offset(flatten_5, if_4)
create_3 = List.Create(offset_3, offset_4)
transpose_2 = List.Transpose(create_3)
byLoft_2 = Surface.ByLoft(transpose_2)
code_block_20 = CodeBlock { 0.02; 1; }
thicken_3 = Surface.Thicken(byLoft_2, code_block_20.out0, code_block_20.out1)
create_4 = List.Create(offset, offset_2)
transpose_3 = List.Transpose(create_4)
byLoft_3 = Surface.ByLoft(transpose_3)
code_block_21 = CodeBlock { 0.02; 1; }
thicken_4 = Surface.Thicken(byLoft_3, code_block_21.out0, code_block_21.out1)
create_5 = List.Create(thicken, thicken_2, thicken_3, thicken_4)
flatten_6 = Flatten(create_5)
byUnion = Solid.ByUnion(flatten_6)
Solid = Output(byUnion)
