# Dynamo custom node triangles.dyf (Dynamo 0.7.5.3566)
# category: Geometry.Curve.Actions
# triangles from grid

point = Input()
X = Point.X(point)
x = Input()
Y = Point.Y(point)
sidelength = Input()
code_block = CodeBlock(a=X, x=x, b=Y, sidelength=sidelength) { a+x; b+sidelength/2; b-sidelength/2; }
byCoordinates = Point.ByCoordinates(code_block.out0, code_block.out1)
byCoordinates_2 = Point.ByCoordinates(code_block.out0, code_block.out2)
y = Input()
code_block_2 = CodeBlock(a=X, y=y, x=x) { a-(y-x); }
byCoordinates_3 = Point.ByCoordinates(code_block_2, Y)
create = List.Create(byCoordinates, byCoordinates_2, byCoordinates_3)
transpose = List.Transpose(create)
code_block_3 = CodeBlock { 1; }
byPoints = PolyCurve.ByPoints(transpose, code_block_3)
ZAxis = Vector.ZAxis()
angle = Input()
rotate = Geometry.Rotate(byPoints, point, ZAxis, angle)
points = Output(rotate)
