# Dynamo graph Rebars.dyn (Dynamo 1.3.2.2480)

views = Views("{3D}")

# group: Input
# note: Select Rebar
select_model_element = DSModelElementSelection()
# note: Select Path
select_model_element_2 = DSModelElementSelection()
distance_between_rebars = DoubleSlider(177.5, range=0..500 step 0.1)

getHost = DiRoots.Structural.Query.GetHost(select_model_element)
getRebarProperties = DiRoots.Structural.Query.GetRebarProperties(select_model_element)
curves = Element.Curves(select_model_element_2)
getCenterLineCurves = DiRoots.Structural.Query.GetCenterLineCurves(select_model_element)
distributionByShapeAndPath = DiRoots.Structural.Create.DistributionByShapeAndPath(getHost, curves, getCenterLineCurves, arg5=distance_between_rebars)
boolean = BoolSelector(false)
rebarByCurves = DiRoots.Structural.Create.RebarByCurves(getHost, getRebarProperties.out0, getRebarProperties.out1, getRebarProperties.out2, getRebarProperties.out3, getRebarProperties.out4, getRebarProperties.out5, distributionByShapeAndPath.out4, boolean)
setSolidInView = DiRoots.Structural.Visibility.SetSolidInView(views, rebarByCurves)
setUnobscuredInView = DiRoots.Structural.Visibility.SetUnobscuredInView(views, rebarByCurves)
