# Dynamo custom node Align Part By Connectors and Couple.dyf (Dynamo 1.0.0.1180)
# category: DynaFabrication2017.Parts
# Align parts by specified connectors.  Will couple if Boolean set to True

Boolean = Input()
Connector = Input()
Connector_To = Input()
Degrees = Input()
degreesToRadians = Math.DegreesToRadians(Degrees)
fabrication_align_connectors = Python(IN[0]=Boolean, IN[1]=Connector, IN[2]=Connector_To, IN[3]=degreesToRadians)
# ---------- fabrication_align_connectors.python (43 lines) ----------
#Copyright(c) 2016, Nathan Chapman
# nchapman@generalheating.com

import clr
clr.AddReference('RevitAPI')
from Autodesk.Revit.DB import *
import clr
clr.AddReference("RevitAPI")
import Autodesk
from Autodesk.Revit.DB import FabricationPart

clr.AddReference("RevitNodes")
import Revit
clr.ImportExtensions(Revit.Elements)

clr.AddReference("RevitServices")
import RevitServices
from RevitServices.Persistence import DocumentManager
from RevitServices.Transactions import TransactionManager
clr.ImportExtensions(Revit.GeometryConversion)


CpleBoo= UnwrapElement(IN[0])
Conn= UnwrapElement(IN[1])
ConnTo= UnwrapElement(IN[2])
Rot= UnwrapElement(IN[3])
ItmList = list()

Doc = DocumentManager.Instance.CurrentDBDocument
TransactionManager.Instance.EnsureInTransaction(Doc)

for Item in Conn:
	for Item1 in ConnTo:
		FabricationPart.AlignPartByConnectors(Doc, Item, Item1, Rot)
		
if CpleBoo == True:
	for Item in Conn:
		for Item1 in ConnTo:
			FabricationPart.ConnectAndCouple(Doc, Item, Item1)	

TransactionManager.Instance.TransactionTaskDone()

#OUT = ItmList
# ----------------------------------------
