# Dynamo custom node Application Information.dyf (Dynamo 1.0.0.1180)
# category: DynaFabrication2017.Util
# Get information about the current Revit setup

application_information = Python()
# ---------- application_information.python (45 lines) ----------
#Copyright(c) 2016, Nathan Chapman
# nchapman@generalheating.com

import clr
clr.AddReference("RevitServices")
import RevitServices
from RevitServices.Persistence import DocumentManager

ItmList = list()
ItmList1 = list()

Doc = DocumentManager.Instance.CurrentDBDocument
UiApp = DocumentManager.Instance.CurrentUIApplication
App = UiApp.Application
ItmList.append(App.VersionName)
ItmList.append(App.VersionNumber)
ItmList.append(App.VersionBuild)
ItmList.append(App.Username)
if len(App.LoginUserId) > 0:
	ItmList.append(App.LoginUserId)
else:
	ItmList.append("Not Logged Into A360")
ItmList.append(App.Language)
if len(App.CurrentRevitServerAccelerator) > 0:
	ItmList.append(App.CurrentRevitServerAccelerator)
else:
	ItmList.append("Revit Accelerator Not Set")
ItmList.append(App.AllUsersAddinsLocation)
ItmList.append(App.CurrentUserAddinsLocation)
if len(App.DefaultIFCProjectTemplate) > 0:
	ItmList.append(App.DefaultIFCProjectTemplate)
else:
	ItmList.append("No IFC Template Set")
ItmList.append(App.DefaultProjectTemplate)
ItmList.append(App.DefaultViewDiscipline)
ItmList.append(App.FamilyTemplatePath)
ItmList.append(App.PointCloudsRootPath)
ItmList.append(App.RecordingJournalFilename)
if len(App.SharedParametersFilename) > 0:
	ItmList.append(App.SharedParametersFilename)
else:
	ItmList.append("No Shared Parameter File Set")
ItmList1.append(App.GetLibraryPaths())

OUT = ItmList, ItmList1
# ----------------------------------------
code_block = CodeBlock(seq=application_information) { seq[0]; }
code_block_2 = CodeBlock(seq=code_block)
# ---------- code_block_2.designscript (16 lines) ----------
seq[0];
seq[1];
seq[2];
seq[3];
seq[4];
seq[5];
seq[6];
seq[7];
seq[8];
seq[9];
seq[10];
seq[11];
seq[12];
seq[13];
seq[14];
seq[15];
# ----------------------------------------
Build = Output(code_block_2.out2)
Version = Output(code_block_2.out1)
Name = Output(code_block_2.out0)
UserName = Output(code_block_2.out3)
A360_Login_User_ID = Output(code_block_2.out4)
Language = Output(code_block_2.out5)
Revit_Server_Accelerater = Output(code_block_2.out6)
All_User_Addin_Directory = Output(code_block_2.out7)
Current_User_Addin_Directory = Output(code_block_2.out8)
Default_IFC_Template_Directory = Output(code_block_2.out9)
Default_Project_Template_Directory = Output(code_block_2.out10)
Default_View_Discipline = Output(code_block_2.out11)
Default_Family_Template_Directory = Output(code_block_2.out12)
Default_Point_Cloud_Directory = Output(code_block_2.out13)
Recording_Journal_File_Directory = Output(code_block_2.out14)
Shared_Parameter_File_Directory = Output(code_block_2.out15)
code_block_3 = CodeBlock(seq=application_information) { seq[1]; }
flatten = Flatten(code_block_3)
Content_Directory = Output(flatten)
