# Dynamo custom node Clear Graphics Selection.dyf (Dynamo 1.0.0.1180)
# category: DynaFabrication2017.Util
# RME to FAB clear graphics.  If node doesnt work execute the button manualy and look in the journal file.  You will see something like this  Jrn.RibbonEvent "Execute external command:CustomCtrl_%CustomCtrl_%Add-Ins%RME to FAB%Clear Graphics Selection:RVTFabExchange.ClearGraphicsElementsCmd". Take inbetween the first : and next : and put in string in node.

string = StringInput("CustomCtrl_%CustomCtrl_%Add-Ins%RME to FAB%Clear Graphics Selection")
external_command = Python(IN[0]=string)
# ---------- external_command.python (29 lines) ----------
#Copyright(c) 2016, Nathan Chapman
# nchapman@generalheating.com

import clr
clr.AddReference("RevitAPI")
clr.AddReference('RevitAPIUI')
import Autodesk
from Autodesk.Revit.UI import RevitCommandId
from Autodesk.Revit.UI import UIApplication
clr.AddReference("RevitServices")
import RevitServices
from RevitServices.Persistence import DocumentManager
from RevitServices.Transactions import TransactionManager

Doc = DocumentManager.Instance.CurrentDBDocument
App =  DocumentManager.Instance.CurrentUIApplication

ItmList = list()
ItmList1 = list()
Inpt = IN[0]

CmmdID= RevitCommandId.LookupCommandId(Inpt)
CmId = CmmdID.Id
App.PostCommand(CmmdID)
	
ItmList.append(CmmdID)
ItmList1.append(CmId)

OUT = ItmList, ItmList1
# ----------------------------------------
