# Dynamo custom node Connector(s) Information.dyf (Dynamo 1.0.0.1180)
# category: DynaFabrication2017.Parts
# Gets the connector(s) information.  Can be used with both fabrication and non fabrication connector(s).  Owner name and ID only work for non fabrication items.

Item_s = Input()  # "Item(s)"
count = Count(Item_s)
connector_manager = Python(IN[0]=Item_s, IN[1]=count)
# ---------- connector_manager.python (32 lines) ----------
#Copyright(c) 2016, Nathan Chapman
# nchapman@generalheating.com

import clr
clr.AddReference('RevitAPI')
from Autodesk.Revit.DB import *
import clr
clr.AddReference("RevitAPI")
import Autodesk
from Autodesk.Revit.DB import FabricationPart

clr.AddReference("RevitNodes")
import Revit
clr.ImportExtensions(Revit.Elements)

Inpt = UnwrapElement(IN[0])
Cnt = UnwrapElement(IN[1])
ItmList = list()

if Cnt > 1:
	for Item in Inpt:
	
		ConnMng = Item.ConnectorManager
		ConnUsed = ConnMng.Connectors
		ItmList.append(ConnUsed)

else:
	ConnMng = Inpt.ConnectorManager
	ConnUsed = ConnMng.Connectors
	ItmList.append(ConnUsed)

OUT = ItmList
# ----------------------------------------
flatten = Flatten(connector_manager)
connector_origin = Python(IN[0]=flatten)
# ---------- connector_origin.python (24 lines) ----------
#Copyright(c) 2016, Nathan Chapman
# nchapman@generalheating.com

import clr
clr.AddReference('RevitAPI')
from Autodesk.Revit.DB import *
import clr
clr.AddReference("RevitAPI")
import Autodesk
from Autodesk.Revit.DB import FabricationPart

clr.AddReference("RevitNodes")
import Revit
clr.ImportExtensions(Revit.Elements)

Inpt = UnwrapElement(IN[0])
ItmList = list()

for Item in Inpt:

	ConnOrgn = Item.Origin
	ItmList.append(ConnOrgn)
	
OUT = ItmList
# ----------------------------------------
Origin = Output(connector_origin)
connector_id = Python(IN[0]=flatten)
# ---------- connector_id.python (24 lines) ----------
#Copyright(c) 2016, Nathan Chapman
# nchapman@generalheating.com

import clr
clr.AddReference('RevitAPI')
from Autodesk.Revit.DB import *
import clr
clr.AddReference("RevitAPI")
import Autodesk
from Autodesk.Revit.DB import FabricationPart

clr.AddReference("RevitNodes")
import Revit
clr.ImportExtensions(Revit.Elements)

Inpt = UnwrapElement(IN[0])
ItmList = list()

for Item in Inpt:

	ConnID = Item.Id
	ItmList.append(ConnID)
	
OUT = ItmList
# ----------------------------------------
Id = Output(connector_id)
connector_manager_mep_info = Python(IN[0]=flatten)
# ---------- connector_manager_mep_info.python (24 lines) ----------
#Copyright(c) 2016, Nathan Chapman
# nchapman@generalheating.com

import clr
clr.AddReference('RevitAPI')
from Autodesk.Revit.DB import *
import clr
clr.AddReference("RevitAPI")
import Autodesk
from Autodesk.Revit.DB import FabricationPart

clr.AddReference("RevitNodes")
import Revit
clr.ImportExtensions(Revit.Elements)

Inpt = UnwrapElement(IN[0])
ItmList = list()

for Item in Inpt:

	ConnMEPInfo = Item.GetMEPConnectorInfo()
	ItmList.append(ConnMEPInfo)
	
OUT = ItmList
# ----------------------------------------
connector_is_primary = Python(IN[0]=connector_manager_mep_info)
# ---------- connector_is_primary.python (24 lines) ----------
#Copyright(c) 2016, Nathan Chapman
# nchapman@generalheating.com

import clr
clr.AddReference('RevitAPI')
from Autodesk.Revit.DB import *
import clr
clr.AddReference("RevitAPI")
import Autodesk
from Autodesk.Revit.DB import FabricationPart

clr.AddReference("RevitNodes")
import Revit
clr.ImportExtensions(Revit.Elements)

Inpt = UnwrapElement(IN[0])
ItmList = list()

for Item in Inpt:

	ConnPri = Item.IsPrimary
	ItmList.append(ConnPri)
	
OUT = ItmList
# ----------------------------------------
boolean = BoolSelector(true)
allIndicesOf = List.AllIndicesOf(list=connector_is_primary, item=boolean)
getItemAtIndex = List.GetItemAtIndex(list=flatten, index=allIndicesOf)
Is_Primary = Output(getItemAtIndex)
connector_is_secondary = Python(IN[0]=connector_manager_mep_info)
# ---------- connector_is_secondary.python (24 lines) ----------
#Copyright(c) 2016, Nathan Chapman
# nchapman@generalheating.com

import clr
clr.AddReference('RevitAPI')
from Autodesk.Revit.DB import *
import clr
clr.AddReference("RevitAPI")
import Autodesk
from Autodesk.Revit.DB import FabricationPart

clr.AddReference("RevitNodes")
import Revit
clr.ImportExtensions(Revit.Elements)

Inpt = UnwrapElement(IN[0])
ItmList = list()

for Item in Inpt:

	ConnSec = Item.IsSecondary
	ItmList.append(ConnSec)
	
OUT = ItmList
# ----------------------------------------
boolean_2 = BoolSelector(true)
allIndicesOf_2 = List.AllIndicesOf(list=connector_is_secondary, item=boolean_2)
getItemAtIndex_2 = List.GetItemAtIndex(list=flatten, index=allIndicesOf_2)
Is_Secondary = Output(getItemAtIndex_2)
connector_is_connected = Python(IN[0]=flatten)
# ---------- connector_is_connected.python (24 lines) ----------
#Copyright(c) 2016, Nathan Chapman
# nchapman@generalheating.com

import clr
clr.AddReference('RevitAPI')
from Autodesk.Revit.DB import *
import clr
clr.AddReference("RevitAPI")
import Autodesk
from Autodesk.Revit.DB import FabricationPart

clr.AddReference("RevitNodes")
import Revit
clr.ImportExtensions(Revit.Elements)

Inpt = UnwrapElement(IN[0])
ItmList  = list()

for Item in Inpt:

	IsConntd = Item.IsConnected
	ItmList.append(IsConntd)
	
OUT = ItmList 
# ----------------------------------------
Is_Connected = Output(connector_is_connected)
connector_shape = Python(IN[0]=flatten)
# ---------- connector_shape.python (24 lines) ----------
#Copyright(c) 2016, Nathan Chapman
# nchapman@generalheating.com

import clr
clr.AddReference('RevitAPI')
from Autodesk.Revit.DB import *
import clr
clr.AddReference("RevitAPI")
import Autodesk
from Autodesk.Revit.DB import FabricationPart

clr.AddReference("RevitNodes")
import Revit
clr.ImportExtensions(Revit.Elements)

Inpt = UnwrapElement(IN[0])
ItmList = list()

for Item in Inpt:

	ConnShape = Item.Shape
	ItmList.append(ConnShape)
	
OUT = ItmList
# ----------------------------------------
Shape = Output(connector_shape)
connector_domain = Python(IN[0]=flatten)
# ---------- connector_domain.python (24 lines) ----------
#Copyright(c) 2016, Nathan Chapman
# nchapman@generalheating.com

import clr
clr.AddReference('RevitAPI')
from Autodesk.Revit.DB import *
import clr
clr.AddReference("RevitAPI")
import Autodesk
from Autodesk.Revit.DB import FabricationPart

clr.AddReference("RevitNodes")
import Revit
clr.ImportExtensions(Revit.Elements)

Inpt = UnwrapElement(IN[0])
ItmList = list()

for Item in Inpt:

	Domn = Item.Domain
	ItmList.append(Domn)
	
OUT = ItmList
# ----------------------------------------
Domain = Output(connector_domain)
connected_allrefs = Python(IN[0]=flatten)
# ---------- connected_allrefs.python (24 lines) ----------
#Copyright(c) 2016, Nathan Chapman
# nchapman@generalheating.com

import clr
clr.AddReference('RevitAPI')
from Autodesk.Revit.DB import *
import clr
clr.AddReference("RevitAPI")
import Autodesk
from Autodesk.Revit.DB import FabricationPart

clr.AddReference("RevitNodes")
import Revit
clr.ImportExtensions(Revit.Elements)

Inpt = UnwrapElement(IN[0])
ItmList = list()

for Item in Inpt:

	ConnRefs = Item.AllRefs
	ItmList.append(ConnRefs)
	
OUT = ItmList
# ----------------------------------------
flatten_2 = Flatten(connected_allrefs)
owner_name = Python(IN[0]=flatten_2)
# ---------- owner_name.python (24 lines) ----------
#Copyright(c) 2016, Nathan Chapman
# nchapman@generalheating.com

import clr
clr.AddReference('RevitAPI')
from Autodesk.Revit.DB import *
import clr
clr.AddReference("RevitAPI")
import Autodesk
from Autodesk.Revit.DB import FabricationPart

clr.AddReference("RevitNodes")
import Revit
clr.ImportExtensions(Revit.Elements)

Inpt = UnwrapElement(IN[0])
ItmList = list()

for Item in Inpt:

	OwnNme = Item.Owner.Name
	ItmList.append(OwnNme)
	
OUT = ItmList
# ----------------------------------------
Owner_Name = Output(owner_name)
owner_id = Python(IN[0]=flatten_2)
# ---------- owner_id.python (24 lines) ----------
#Copyright(c) 2016, Nathan Chapman
# nchapman@generalheating.com

import clr
clr.AddReference('RevitAPI')
from Autodesk.Revit.DB import *
import clr
clr.AddReference("RevitAPI")
import Autodesk
from Autodesk.Revit.DB import FabricationPart

clr.AddReference("RevitNodes")
import Revit
clr.ImportExtensions(Revit.Elements)

Inpt = UnwrapElement(IN[0])
ItmList = list()

for Item in Inpt:

	OwnID = Item.Owner.Id
	ItmList.append(OwnID)
	
OUT = ItmList
# ----------------------------------------
Owner_ID = Output(owner_id)
