# Dynamo custom node Create Fabrication Part (Button).dyf (Dynamo 1.0.0.1180)
# category: DynaFabrication2017.Parts
# Create fabricatin part based off doc, servicebutton, condition and level.  Places at 0,0,0.

Service_Button = Input()
Condition = Input()
Level = Input()
id = Element.Id(Level)
fabrication_create = Python(IN[0]=Service_Button, IN[1]=Condition, IN[2]=id)
# ---------- fabrication_create.python (28 lines) ----------
#Copyright(c) 2016, Nathan Chapman
# nchapman@generalheating.com

import clr
clr.AddReference("RevitAPI")
import Autodesk
from Autodesk.Revit.DB import FabricationPart
from Autodesk.Revit.DB import ElementId
clr.AddReference("RevitServices")
import RevitServices
from RevitServices.Persistence import DocumentManager
from RevitServices.Transactions import TransactionManager

ServBttn = IN[0]
Cntion = IN[1]
Lvl = IN[2]
ItmList = list()

Doc = DocumentManager.Instance.CurrentDBDocument
TransactionManager.Instance.EnsureInTransaction(Doc)

id = ElementId(int(Lvl))
FabCrte = FabricationPart.Create(Doc,ServBttn,Cntion,id) 
ItmList.append(FabCrte)

TransactionManager.Instance.TransactionTaskDone()

OUT = ItmList
# ----------------------------------------
