# Dynamo custom node Design To Fabrication Converter.dyf (Dynamo 1.0.0.1180)
# category: DynaFabrication2017.Util
# Convert design elements to fabrication parts

Service_ID = Input()
Element_s = Input()  # "Element(s)"
count = Count(Element_s)
design_to_fabrication = Python(IN[0]=Service_ID, IN[1]=Element_s, IN[2]=count)
# ---------- design_to_fabrication.python (51 lines) ----------
#Copyright(c) 2016, Nathan Chapman
# nchapman@generalheating.com

import clr
clr.AddReference('RevitAPI')
from Autodesk.Revit.DB import *
from Autodesk.Revit.DB import Fabrication

clr.AddReference("RevitNodes")
import Revit
clr.ImportExtensions(Revit.Elements)

clr.AddReference("RevitServices")
import RevitServices
from RevitServices.Persistence import DocumentManager
from RevitServices.Transactions import TransactionManager
clr.ImportExtensions(Revit.GeometryConversion)

import clr
import System
clr.AddReference("System.Core")
from System.Collections.Generic import HashSet

ServId = UnwrapElement(IN[0])
ElemId = UnwrapElement(IN[1])
Cnt = IN[2]

MyHashSet = HashSet[ElementId]()
ItmList = list()

Doc = DocumentManager.Instance.CurrentDBDocument
TransactionManager.Instance.EnsureInTransaction(Doc)
Converter = Fabrication.DesignToFabricationConverter(Doc)
	
if Cnt > 1:
	for Item in ElemId:
		MyHashSet.Add(Item.Id)

	for Item1 in ServId:
		Converter.Convert(MyHashSet, Item1)
		ItmList.append(Converter.GetConvertedFabricationParts())
else:
	MyHashSet.Add(ElemId.Id)

	for Item1 in ServId:
		Converter.Convert(MyHashSet, Item1)
		ItmList.append(Converter.GetConvertedFabricationParts())
		
TransactionManager.Instance.TransactionTaskDone()

OUT = ItmList
# ----------------------------------------
Fab_ID_s = Output(design_to_fabrication)  # "Fab ID(s)"
