# Dynamo custom node Dropdown List.dyf (Dynamo 1.0.0.1180)
# category: DynaFabrication2017.Util

Reset = Input(Reset:bool = true)
Input = Input()
python_script = Python(IN[0]=Reset, IN[1]=Input)
# ---------- python_script.python (67 lines) ----------
#Copyright(c) 2015, Dimitar Venkov
# @5devene, dimitar.ven@gmail.com

#Modified by @josols ,josols@hotmail.com for QRCoder

import clr
clr.AddReference('System.Windows.Forms')
clr.AddReference('System.Drawing')

from System.Drawing import Point, Color, Font
from System.Windows.Forms import *
from System import Array, Object

def tolist(obj1):
	if hasattr(obj1,"__iter__"): return obj1
	else: return [obj1]

class DropDownForm(Form):
	def __init__(self):
		self.Text = "Fabrication Services"
		self.Width = 340
		self.Height = 112
		self.BackColor = Color.FromArgb(40,40,40)
		self.ControlBox = False
		self.FormBorderStyle = FormBorderStyle.FixedDialog
		self.StartPosition = FormStartPosition.CenterScreen
		
		self.combo1 = ComboBox()
		self.combo1.Location = Point(5, 5)
		self.combo1.Width = 325
		self.combo1.BackColor = Color.FromArgb(53,53,53)
		self.combo1.ForeColor = Color.FromArgb(234,234,234)
		self.combo1.Font = Font("Calibri", 11)
		self.combo1.MouseClick += self.expand
		self.Controls.Add(self.combo1)
		
		self.button1 = Button()
		self.button1.Text = 'Select'
		self.button1.AutoSize = True
		self.button1.Width = 325
		self.button1.Location = Point(5, 42)
		self.button1.ForeColor = Color.FromArgb(234,234,234)
		self.button1.Font = Font("Calibri", 11)
		self.button1.Click += self.save
		self.Controls.Add(self.button1)
	
	def expand(self, sender, event):
		self.combo1.DroppedDown = True
	def add_range(self,l1):
		self.combo1.Items.AddRange(l1)	
		if l1.Length >= 1:
			self.combo1.SelectedIndex = 0
	def save(self, sender, event):
		self.output1 = self.combo1.SelectedItem
		self.Close()
Test = IN[1]
#ArrayList = list(Test)
Test2 = Test.split(',')
#l1=[Test]

#l1=ArrayList
l1_arr = Array[Object](Test2)
form = DropDownForm()
form.add_range(l1_arr)
Application.Run(form)
OUT = form.output1
Application.Exit()
# ----------------------------------------
selection = Output(python_script)
