# Dynamo custom node Fabrication Specification Dropdown List.dyf (Dynamo 1.0.0.1180)
# category: DynaFabrication2017.Parts
# Dropdown list of all specifications

fabrication_all_specification_id = Python()  # "Fabrication All Specification ID's"
# ---------- fabrication_all_specification_id.python (20 lines) ----------
#Copyright(c) 2016, Nathan Chapman
# nchapman@generalheating.com

import clr
clr.AddReference("RevitAPI")
import Autodesk
from Autodesk.Revit.DB import FabricationConfiguration
clr.AddReference("RevitServices")
import RevitServices
from RevitServices.Persistence import DocumentManager

Doc = DocumentManager.Instance.CurrentDBDocument

ItmList = list()

Config = FabricationConfiguration.GetFabricationConfiguration(Doc)
AllSpecs = Config.GetAllSpecifications(None)
ItmList.append(AllSpecs)

OUT = ItmList
# ----------------------------------------
flatten = Flatten(fabrication_all_specification_id)
fabrication_specification_name = Python(IN[0]=flatten)
# ---------- fabrication_specification_name.python (23 lines) ----------
#Copyright(c) 2016, Nathan Chapman
# nchapman@generalheating.com

import clr
clr.AddReference("RevitAPI")
import Autodesk
from Autodesk.Revit.DB import FabricationConfiguration
clr.AddReference("RevitServices")
import RevitServices
from RevitServices.Persistence import DocumentManager

Inpt = UnwrapElement(IN[0])
ItmList = list()

Doc = DocumentManager.Instance.CurrentDBDocument

Config = FabricationConfiguration.GetFabricationConfiguration(Doc)

for Item in Inpt:
	SpecName = Config.GetSpecificationName(Item)
	ItmList.append(SpecName)

OUT = ItmList
# ----------------------------------------
string_from_array = FromArray(fabrication_specification_name)
string = StringInput("\"")
string_2 = StringInput("")
replace = String.Replace(str=string_from_array, searchFor=string, replaceWith=string_2)
boolean = BoolSelector(true)
string_3 = StringInput("{")
string_4 = StringInput("")
replace_2 = String.Replace(str=string_from_array, searchFor=string_3, replaceWith=string_4)
string_5 = StringInput("}")
string_6 = StringInput("")
replace_3 = String.Replace(str=replace_2, searchFor=string_5, replaceWith=string_6)
dropdown_list = Custom[Dropdown List](Reset=boolean, Input=replace_3)
Name = Output(dropdown_list)
number = DoubleInput(1)
flatten_2 = List.Flatten(list=fabrication_all_specification_id, amt=number)
indexOf = IndexOf(fabrication_specification_name, dropdown_list)
getItemAtIndex = List.GetItemAtIndex(list=flatten_2, index=indexOf)
ID = Output(getItemAtIndex)
