# Dynamo custom node Get All Fabrication Connector(s).dyf (Dynamo 1.0.0.1180)
# category: DynaFabrication2017.Configuration
# Gets all the Connector(s) in the configuration

fabrication_all_connector_id_s = Python()
# ---------- fabrication_all_connector_id_s.python (23 lines) ----------
#Copyright(c) 2016, Nathan Chapman
# nchapman@generalheating.com

import clr
clr.AddReference("RevitAPI")
import Autodesk
from Autodesk.Revit.DB import FabricationConfiguration
from Autodesk.Revit.DB import ConnectorDomainType
from Autodesk.Revit.DB import ConnectorProfileType

clr.AddReference("RevitServices")
import RevitServices
from RevitServices.Persistence import DocumentManager

Doc = DocumentManager.Instance.CurrentDBDocument

ItmList = list()

Config = FabricationConfiguration.GetFabricationConfiguration(Doc)
AllInsSpecs = Config.GetAllFabricationConnectorDefinitions(ConnectorDomainType.Undefined, ConnectorProfileType.Invalid)
ItmList.append(AllInsSpecs)

OUT = ItmList
# ----------------------------------------
flatten = Flatten(fabrication_all_connector_id_s)
fabrication_connector_domain = Python(IN[0]=flatten)
# ---------- fabrication_connector_domain.python (23 lines) ----------
#Copyright(c) 2016, Nathan Chapman
# nchapman@generalheating.com

import clr
clr.AddReference("RevitAPI")
import Autodesk
from Autodesk.Revit.DB import FabricationConfiguration
clr.AddReference("RevitServices")
import RevitServices
from RevitServices.Persistence import DocumentManager

Inpt = UnwrapElement(IN[0])
ItmList = list()

Doc = DocumentManager.Instance.CurrentDBDocument

Config = FabricationConfiguration.GetFabricationConfiguration(Doc)

for Item in Inpt:
	InsSpecAbrn = Config.GetFabricationConnectorDomain(Item)
	ItmList.append(InsSpecAbrn)

OUT = ItmList
# ----------------------------------------
Connector_Domain = Output(fabrication_connector_domain)
fabrication_connector_group = Python(IN[0]=flatten)
# ---------- fabrication_connector_group.python (23 lines) ----------
#Copyright(c) 2016, Nathan Chapman
# nchapman@generalheating.com

import clr
clr.AddReference("RevitAPI")
import Autodesk
from Autodesk.Revit.DB import FabricationConfiguration
clr.AddReference("RevitServices")
import RevitServices
from RevitServices.Persistence import DocumentManager

Inpt = UnwrapElement(IN[0])
ItmList = list()

Doc = DocumentManager.Instance.CurrentDBDocument

Config = FabricationConfiguration.GetFabricationConfiguration(Doc)

for Item in Inpt:
	InsSpecGrp = Config.GetFabricationConnectorGroup(Item)
	ItmList.append(InsSpecGrp)

OUT = ItmList
# ----------------------------------------
Connector_Group = Output(fabrication_connector_group)
fabrication_connector_name = Python(IN[0]=flatten)
# ---------- fabrication_connector_name.python (23 lines) ----------
#Copyright(c) 2016, Nathan Chapman
# nchapman@generalheating.com

import clr
clr.AddReference("RevitAPI")
import Autodesk
from Autodesk.Revit.DB import FabricationConfiguration
clr.AddReference("RevitServices")
import RevitServices
from RevitServices.Persistence import DocumentManager

Inpt = UnwrapElement(IN[0])
ItmList = list()

Doc = DocumentManager.Instance.CurrentDBDocument

Config = FabricationConfiguration.GetFabricationConfiguration(Doc)

for Item in Inpt:
	InsSpecName = Config.GetFabricationConnectorName(Item)
	ItmList.append(InsSpecName)

OUT = ItmList
# ----------------------------------------
Connector_Name = Output(fabrication_connector_name)
fabrication_connector_shape = Python(IN[0]=flatten)
# ---------- fabrication_connector_shape.python (23 lines) ----------
#Copyright(c) 2016, Nathan Chapman
# nchapman@generalheating.com

import clr
clr.AddReference("RevitAPI")
import Autodesk
from Autodesk.Revit.DB import FabricationConfiguration
clr.AddReference("RevitServices")
import RevitServices
from RevitServices.Persistence import DocumentManager

Inpt = UnwrapElement(IN[0])
ItmList = list()

Doc = DocumentManager.Instance.CurrentDBDocument

Config = FabricationConfiguration.GetFabricationConfiguration(Doc)

for Item in Inpt:
	InsSpecAbrn = Config.GetFabricationConnectorShape(Item)
	ItmList.append(InsSpecAbrn)

OUT = ItmList
# ----------------------------------------
Connector_Shape = Output(fabrication_connector_shape)
Connector_ID = Output(flatten)
