# Dynamo custom node Get All Fabrication Service(s).dyf (Dynamo 1.0.0.1180)
# category: DynaFabrication2017.Configuration
# Get all fabrication services in loaded configuration

fabrication_services_all = Python()
# ---------- fabrication_services_all.python (20 lines) ----------
#Copyright(c) 2016, Nathan Chapman
# nchapman@generalheating.com

import clr
clr.AddReference("RevitAPI")
import Autodesk
from Autodesk.Revit.DB import FabricationConfiguration
clr.AddReference("RevitServices")
import RevitServices
from RevitServices.Persistence import DocumentManager

Doc = DocumentManager.Instance.CurrentDBDocument

ItmList = list()

Config = FabricationConfiguration.GetFabricationConfiguration(Doc)
AllServices = Config.GetAllServices()
ItmList.append(AllServices)

OUT = ItmList
# ----------------------------------------
flatten = Flatten(fabrication_services_all)
ID = Python(IN[0]=flatten)
# ---------- ID.python (17 lines) ----------
#Copyright(c) 2016, Nathan Chapman
# nchapman@generalheating.com

import clr
clr.AddReference('RevitAPI')
from Autodesk.Revit.DB import *

Inpt = UnwrapElement(IN[0])
ItmList = list()

for Item in Inpt:
	try:
		ItmList.append(Item.ServiceId)
	except:
		ItmList.append(list())
		
OUT = ItmList
# ----------------------------------------
Service_s_ID = Output(ID)  # "Service(s) ID"
flatten_2 = Flatten(fabrication_services_all)
name = Python(IN[0]=flatten_2)
# ---------- name.python (17 lines) ----------
#Copyright(c) 2016, Nathan Chapman
# nchapman@generalheating.com

import clr
clr.AddReference('RevitAPI')
from Autodesk.Revit.DB import *

Inpt = UnwrapElement(IN[0])
ItmList = list()

for Item in Inpt:
	try:
		ItmList.append(Item.Name)
	except:
		ItmList.append(list())
		
OUT = ItmList
# ----------------------------------------
Service_s_Name = Output(name)  # "Service(s) Name"
