# Dynamo custom node Get All Loaded Fabrication Service(s).dyf (Dynamo 1.0.0.1180)
# category: DynaFabrication2017.Configuration
# Get all loaded services in document

fabrication_services_loaded = Python()
# ---------- fabrication_services_loaded.python (20 lines) ----------
#Copyright(c) 2016, Nathan Chapman
# nchapman@generalheating.com

import clr
clr.AddReference("RevitAPI")
import Autodesk
from Autodesk.Revit.DB import FabricationConfiguration
clr.AddReference("RevitServices")
import RevitServices
from RevitServices.Persistence import DocumentManager

Doc = DocumentManager.Instance.CurrentDBDocument

ItmList = list()

Config = FabricationConfiguration.GetFabricationConfiguration(Doc)
LoadedServices = Config.GetAllLoadedServices()
ItmList.append(LoadedServices)

OUT = ItmList
# ----------------------------------------
flatten = Flatten(fabrication_services_loaded)
fabrication_service_id = Python(IN[0]=flatten)
# ---------- fabrication_service_id.python (17 lines) ----------
#Copyright(c) 2016, Nathan Chapman
# nchapman@generalheating.com

import clr
clr.AddReference('RevitAPI')
from Autodesk.Revit.DB import *

Inpt = UnwrapElement(IN[0])
ItmList = list()

for Item in Inpt:
	try:
		ItmList.append(Item.ServiceId)
	except:
		ItmList.append(list())
		
OUT = ItmList
# ----------------------------------------
Service_s_ID = Output(fabrication_service_id)  # "Service(s) ID"
fabrication_service_name = Python(IN[0]=flatten)
# ---------- fabrication_service_name.python (17 lines) ----------
#Copyright(c) 2016, Nathan Chapman
# nchapman@generalheating.com

import clr
clr.AddReference('RevitAPI')
from Autodesk.Revit.DB import *

Inpt = UnwrapElement(IN[0])
ItmList = list()

for Item in Inpt:
	try:
		ItmList.append(Item.Name)
	except:
		ItmList.append(list())
		
OUT = ItmList
# ----------------------------------------
Service_s_Name = Output(fabrication_service_name)  # "Service(s) Name"
Service_s_Class = Output(flatten)  # "Service(s) Class"
