# Dynamo custom node Get Fabrication Insulation Specification(s).dyf (Dynamo 1.0.0.1180)
# category: DynaFabrication2017.Configuration
# Sets fabrication part bases of connector

fabrication_all_insulation = Python()  # "Fabrication All Insulation Specification ID's"
# ---------- fabrication_all_insulation.python (20 lines) ----------
#Copyright(c) 2016, Nathan Chapman
# nchapman@generalheating.com

import clr
clr.AddReference("RevitAPI")
import Autodesk
from Autodesk.Revit.DB import FabricationConfiguration
clr.AddReference("RevitServices")
import RevitServices
from RevitServices.Persistence import DocumentManager

Doc = DocumentManager.Instance.CurrentDBDocument

ItmList = list()

Config = FabricationConfiguration.GetFabricationConfiguration(Doc)
AllInsSpecs = Config.GetAllInsulationSpecifications(None)
ItmList.append(AllInsSpecs)

OUT = ItmList
# ----------------------------------------
flatten = Flatten(fabrication_all_insulation)
fabrication_insulation = Python(IN[0]=flatten)  # "Fabrication Insulation Specification Abbreviation"
# ---------- fabrication_insulation.python (23 lines) ----------
#Copyright(c) 2016, Nathan Chapman
# nchapman@generalheating.com

import clr
clr.AddReference("RevitAPI")
import Autodesk
from Autodesk.Revit.DB import FabricationConfiguration
clr.AddReference("RevitServices")
import RevitServices
from RevitServices.Persistence import DocumentManager

Inpt = UnwrapElement(IN[0])
ItmList = list()

Doc = DocumentManager.Instance.CurrentDBDocument

Config = FabricationConfiguration.GetFabricationConfiguration(Doc)

for Item in Inpt:
	InsSpecAbrn = Config.GetInsulationSpecificationAbbreviation(Item)
	ItmList.append(InsSpecAbrn)

OUT = ItmList
# ----------------------------------------
Insul_Spec_Abbreviation = Output(fabrication_insulation)
fabrication_insulation_2 = Python(IN[0]=flatten)  # "Fabrication Insulation Specification Group"
# ---------- fabrication_insulation_2.python (23 lines) ----------
#Copyright(c) 2016, Nathan Chapman
# nchapman@generalheating.com

import clr
clr.AddReference("RevitAPI")
import Autodesk
from Autodesk.Revit.DB import FabricationConfiguration
clr.AddReference("RevitServices")
import RevitServices
from RevitServices.Persistence import DocumentManager

Inpt = UnwrapElement(IN[0])
ItmList = list()

Doc = DocumentManager.Instance.CurrentDBDocument

Config = FabricationConfiguration.GetFabricationConfiguration(Doc)

for Item in Inpt:
	InsSpecGrp = Config.GetInsulationSpecificationGroup(Item)
	ItmList.append(InsSpecGrp)

OUT = ItmList
# ----------------------------------------
Insul_Spec_Group = Output(fabrication_insulation_2)
fabrication_insulation_3 = Python(IN[0]=flatten)  # "Fabrication Insulation Specification Name"
# ---------- fabrication_insulation_3.python (23 lines) ----------
#Copyright(c) 2016, Nathan Chapman
# nchapman@generalheating.com

import clr
clr.AddReference("RevitAPI")
import Autodesk
from Autodesk.Revit.DB import FabricationConfiguration
clr.AddReference("RevitServices")
import RevitServices
from RevitServices.Persistence import DocumentManager

Inpt = UnwrapElement(IN[0])
ItmList = list()

Doc = DocumentManager.Instance.CurrentDBDocument

Config = FabricationConfiguration.GetFabricationConfiguration(Doc)

for Item in Inpt:
	InsSpecName = Config.GetInsulationSpecificationName(Item)
	ItmList.append(InsSpecName)

OUT = ItmList
# ----------------------------------------
Insul_Spec_Name = Output(fabrication_insulation_3)
