# Dynamo custom node Get Fabrication Material Thickness(s).dyf (Dynamo 1.0.0.1180)
# category: DynaFabrication2017.Configuration
# Get the materials gauge thicknesses

Indentifier = Input()
number = DoubleInput(1)
number_2 = DoubleInput(30)
number_3 = DoubleInput(1)
range = Range(start=number, end=number_2, step=number_3, lacing=Longest)
fabrication_material_thickness = Python(IN[0]=Indentifier, IN[1]=range)
# ---------- fabrication_material_thickness.python (22 lines) ----------
import clr
clr.AddReference("RevitAPI")
import Autodesk
from Autodesk.Revit.DB import FabricationConfiguration
clr.AddReference("RevitServices")
import RevitServices
from RevitServices.Persistence import DocumentManager

MatID = IN[0]
GagInd = UnwrapElement(IN[1])

doc = DocumentManager.Instance.CurrentDBDocument
elementlist = list()
elementlist1 = list()
config = FabricationConfiguration.GetFabricationConfiguration(doc)

for item in GagInd:
		MatName = config.GetMaterialThickness(MatID,item)
		
		elementlist.append(MatName)

OUT = elementlist
# ----------------------------------------
number_4 = DoubleInput(12)
mul = fabrication_material_thickness * number_4
number_5 = DoubleInput(6)
round = Math.Round(number=mul, digits=number_5)
number_slider = DoubleSlider(0, range=0..100 step 0.1)
allIndicesOf = List.AllIndicesOf(list=round, item=number_slider)
removeItemAtIndex = List.RemoveItemAtIndex(list=round, indices=allIndicesOf)
Material_Thickness = Output(removeItemAtIndex)
