# Dynamo custom node Get Fabrication Material(s) Information.dyf (Dynamo 1.0.0.1180)
# category: DynaFabrication2017.Configuration
# Get fabrication material information

fabrication_all_material_id_s = Python()
# ---------- fabrication_all_material_id_s.python (22 lines) ----------
import clr
clr.AddReference("RevitAPI")
import Autodesk
from Autodesk.Revit.DB import FabricationConfiguration
clr.AddReference("RevitServices")
import RevitServices
from RevitServices.Persistence import DocumentManager


doc = DocumentManager.Instance.CurrentDBDocument
elementlist = list()
config = FabricationConfiguration.GetFabricationConfiguration(doc)
allInsulSpec = config.GetAllMaterials(None)
#for item in allLoadedServices:
	#Test = config.GetSpecificationName(item)

#elementlist.append(Test)
elementlist.append(allInsulSpec)



OUT = elementlist
# ----------------------------------------
fabrication_material_name = Python(IN[0]=fabrication_all_material_id_s)
# ---------- fabrication_material_name.python (20 lines) ----------
import clr
clr.AddReference("RevitAPI")
import Autodesk
from Autodesk.Revit.DB import FabricationConfiguration
clr.AddReference("RevitServices")
import RevitServices
from RevitServices.Persistence import DocumentManager

SpecID = UnwrapElement(IN[0])

doc = DocumentManager.Instance.CurrentDBDocument
elementlist = list()
config = FabricationConfiguration.GetFabricationConfiguration(doc)

for item in SpecID:
	for itemId in item:
		MatName = config.GetMaterialName(itemId)
		elementlist.append(MatName)

OUT = elementlist
# ----------------------------------------
Material_Name = Output(fabrication_material_name)
fabrication_material_group = Python(IN[0]=fabrication_all_material_id_s)
# ---------- fabrication_material_group.python (20 lines) ----------
import clr
clr.AddReference("RevitAPI")
import Autodesk
from Autodesk.Revit.DB import FabricationConfiguration
clr.AddReference("RevitServices")
import RevitServices
from RevitServices.Persistence import DocumentManager

SpecID = UnwrapElement(IN[0])

doc = DocumentManager.Instance.CurrentDBDocument
elementlist = list()
config = FabricationConfiguration.GetFabricationConfiguration(doc)

for item in SpecID:
	for itemId in item:
		MatGrp = config.GetMaterialGroup(itemId)
		elementlist.append(MatGrp)

OUT = elementlist
# ----------------------------------------
Material_Group = Output(fabrication_material_group)
fabrication_material = Python(IN[0]=fabrication_all_material_id_s)  # "Fabrication Material Abbreviation"
# ---------- fabrication_material.python (20 lines) ----------
import clr
clr.AddReference("RevitAPI")
import Autodesk
from Autodesk.Revit.DB import FabricationConfiguration
clr.AddReference("RevitServices")
import RevitServices
from RevitServices.Persistence import DocumentManager

SpecID = UnwrapElement(IN[0])

doc = DocumentManager.Instance.CurrentDBDocument
elementlist = list()
config = FabricationConfiguration.GetFabricationConfiguration(doc)

for item in SpecID:
	for itemId in item:
		MatAbrn = config.GetMaterialAbbreviation(itemId)
		elementlist.append(MatAbrn)

OUT = elementlist
# ----------------------------------------
Material_Abbreviation = Output(fabrication_material)
Material_Indentifier = Output(fabrication_all_material_id_s)
