# Dynamo custom node Get Fabrication Service Group Button(s).dyf (Dynamo 1.0.0.1180)
# category: DynaFabrication2017.Configuration
# Get the button name and identifier of the specific service and group

Service_s_Class = Input()  # "Service(s) Class"
Group_Index = Input()
number = DoubleInput(0)
getItemAtIndex = List.GetItemAtIndex(list=Group_Index, index=number)
create = List.Create(getItemAtIndex)
button_count = Python(IN[0]=Service_s_Class, IN[1]=create)
# ---------- button_count.python (19 lines) ----------
#Copyright(c) 2016, Nathan Chapman
# nchapman@generalheating.com

import clr
clr.AddReference('RevitAPI')
from Autodesk.Revit.DB import *

Serv = UnwrapElement(IN[0])
GrpInd = UnwrapElement(IN[1])
ItmList = list()

for Item in Serv:
	for Item1 in GrpInd:
		try:
			ItmList.append(Item.GetButtonCount(Item1))
		except:
			ItmList.append(list())
			
OUT = ItmList
# ----------------------------------------
flatten = Flatten(button_count)
Button_Count = Output(flatten)
number_2 = DoubleInput(0)
getItemAtIndex_2 = List.GetItemAtIndex(list=Service_s_Class, index=number_2)
number_3 = DoubleInput(0)
number_4 = DoubleInput(1)
sub = button_count - number_4
number_5 = DoubleInput(1)
range = Range(start=number_3, end=sub, step=number_5, lacing=Longest)
flatten_2 = Flatten(range)
button_name = Python(IN[0]=getItemAtIndex_2, IN[1]=getItemAtIndex, IN[2]=flatten_2)
# ---------- button_name.python (20 lines) ----------
#Copyright(c) 2016, Nathan Chapman
# nchapman@generalheating.com

import clr
clr.AddReference('RevitAPI')
from Autodesk.Revit.DB import *

GrpInd = IN[1]
Serv = IN[0]
ButtInd = UnwrapElement(IN[2])

ItmList = list()

for Item in ButtInd:
	try:
		ItmList.append(Serv.GetButton(GrpInd, Item).Name)
	except:
		ItmList.append(list())
		
OUT = ItmList
# ----------------------------------------
flatten_3 = Flatten(button_name)
Button_Name = Output(flatten_3)
button_class = Python(IN[0]=getItemAtIndex_2, IN[1]=getItemAtIndex, IN[2]=flatten_2)
# ---------- button_class.python (20 lines) ----------
#Copyright(c) 2016, Nathan Chapman
# nchapman@generalheating.com

import clr
clr.AddReference('RevitAPI')
from Autodesk.Revit.DB import *

GrpInd = IN[1]
Serv = IN[0]
ButtInd = UnwrapElement(IN[2])

ItmList = list()

for Item in ButtInd:
	try:
		ItmList.append(Serv.GetButton(GrpInd, Item))
	except:
		ItmList.append(list())
		
OUT = ItmList
# ----------------------------------------
flatten_4 = Flatten(button_class)
Button_Class = Output(flatten_4)
button_condition_count = Python(IN[0]=flatten_4)
# ---------- button_condition_count.python (17 lines) ----------
#Copyright(c) 2016, Nathan Chapman
# nchapman@generalheating.com

import clr
clr.AddReference('RevitAPI')
from Autodesk.Revit.DB import *

ButtClss = UnwrapElement(IN[0])
ItmList = list()

for Item in ButtClss:
	try:
		ItmList.append(Item.ConditionCount)		
	except:
		ItmList.append(list())
		
OUT = ItmList
# ----------------------------------------
flatten_5 = Flatten(button_condition_count)
Button_Condition_Count = Output(flatten_5)
button_condition_description = Python(IN[0]=flatten_4, IN[1]=flatten_5)
# ---------- button_condition_description.python (51 lines) ----------
#Copyright(c) 2016, Nathan Chapman
# nchapman@generalheating.com

import clr
clr.AddReference('RevitAPI')
from Autodesk.Revit.DB import *

ButtClss = UnwrapElement(IN[0])
ButtCndCnt = IN[1]
ItmList = list()


for Item in ButtClss:

	if ButtCndCnt > 4:
		try:
			ItmList.append(Item.GetConditionDescription(0))
			ItmList.append(Item.GetConditionDescription(1))
			ItmList.append(Item.GetConditionDescription(2))
			ItmList.append(Item.GetConditionDescription(3))
			ItmList.append(Item.GetConditionDescription(4))
		except:
			ItmList.append(list())
	elif ButtCndCnt > 3:
		try:
			ItmList.append(Item.GetConditionDescription(0))
			ItmList.append(Item.GetConditionDescription(1))
			ItmList.append(Item.GetConditionDescription(2))
			ItmList.append(Item.GetConditionDescription(3))
		except:
			ItmList.append(list())
	elif ButtCndCnt > 2:
		try:
			ItmList.append(Item.GetConditionDescription(0))
			ItmList.append(Item.GetConditionDescription(1))
			ItmList.append(Item.GetConditionDescription(2))
		except:
			ItmList.append(list())
	elif ButtCndCnt > 1:
		try:
			ItmList.append(Item.GetConditionDescription(0))
			ItmList.append(Item.GetConditionDescription(1))
		except:
			ItmList.append(list())
	else:
		try:
			ItmList.append(Item.GetConditionDescription(1))
		except:
			ItmList.append(list())
			
OUT = ItmList
# ----------------------------------------
flatten_6 = Flatten(button_condition_description)
chop = List.Chop(list=flatten_6, lengths=flatten_5)
Button_Condition_Description = Output(chop)
