# Dynamo custom node Get Fabrication Service Group(s).dyf (Dynamo 1.0.0.1180)
# category: DynaFabrication2017.Configuration
# Gets the group(s) Name and ID associated with the service.

Service_s_Class = Input()  # "Service(s) Class"
number = DoubleInput(0)
fabrication_service_group_count = Python(IN[0]=Service_s_Class)
# ---------- fabrication_service_group_count.python (17 lines) ----------
#Copyright(c) 2016, Nathan Chapman
# nchapman@generalheating.com

import clr
clr.AddReference('RevitAPI')
from Autodesk.Revit.DB import *

Inpt = UnwrapElement(IN[0])
ItmList = list()

for Item in Inpt:
	try:
		ItmList.append(Item.GroupCount)
	except:
		ItmList.append(list())
		
OUT = ItmList
# ----------------------------------------
number_2 = DoubleInput(1)
sub = fabrication_service_group_count - number_2
number_3 = DoubleInput(1)
range = Range(start=number, end=sub, step=number_3, lacing=Longest)
flatten = Flatten(range)
fabrication_service_group_name = Python(IN[0]=Service_s_Class, IN[1]=flatten)
# ---------- fabrication_service_group_name.python (20 lines) ----------
#Copyright(c) 2016, Nathan Chapman
# nchapman@generalheating.com

import clr
clr.AddReference('RevitAPI')
from Autodesk.Revit.DB import *

Inpt = UnwrapElement(IN[0])
GrpInd = UnwrapElement(IN[1])

ItmList = list()

for Item in Inpt:
	for Item1 in GrpInd:
			try:
				ItmList.append(Item.GetGroupName(Item1))
			except:
				ItmList.append(list())

OUT = ItmList
# ----------------------------------------
Group_Name = Output(fabrication_service_group_name)
Group_Index = Output(flatten)
