# Dynamo custom node Get Fabrication Specification(s).dyf (Dynamo 1.0.0.1180)
# category: DynaFabrication2017.Configuration
# Get all fabrication specification(s)

fabrication_all_specification_id = Python()  # "Fabrication All Specification ID's"
# ---------- fabrication_all_specification_id.python (21 lines) ----------
#Copyright(c) 2016, Nathan Chapman
# nchapman@generalheating.com

import clr
clr.AddReference("RevitAPI")
import Autodesk
from Autodesk.Revit.DB import FabricationConfiguration
clr.AddReference("RevitServices")
import RevitServices
from RevitServices.Persistence import DocumentManager

Doc = DocumentManager.Instance.CurrentDBDocument

ItmList = list()

Config = FabricationConfiguration.GetFabricationConfiguration(Doc)
AllSpecs = Config.GetAllSpecifications(None)

ItmList.append(AllSpecs)

OUT = ItmList
# ----------------------------------------
flatten = Flatten(fabrication_all_specification_id)
fabrication_specification_group = Python(IN[0]=flatten)
# ---------- fabrication_specification_group.python (23 lines) ----------
#Copyright(c) 2016, Nathan Chapman
# nchapman@generalheating.com

import clr
clr.AddReference("RevitAPI")
import Autodesk
from Autodesk.Revit.DB import FabricationConfiguration
clr.AddReference("RevitServices")
import RevitServices
from RevitServices.Persistence import DocumentManager

Inpt = UnwrapElement(IN[0])
ItmList = list()

Doc = DocumentManager.Instance.CurrentDBDocument

Config = FabricationConfiguration.GetFabricationConfiguration(Doc)

for Item in Inpt:
	SpecGrp = Config.GetSpecificationGroup(Item)
	ItmList.append(SpecGrp)

OUT = ItmList
# ----------------------------------------
Spec_Group = Output(fabrication_specification_group)
fabrication_specification_name = Python(IN[0]=flatten)
# ---------- fabrication_specification_name.python (23 lines) ----------
#Copyright(c) 2016, Nathan Chapman
# nchapman@generalheating.com

import clr
clr.AddReference("RevitAPI")
import Autodesk
from Autodesk.Revit.DB import FabricationConfiguration
clr.AddReference("RevitServices")
import RevitServices
from RevitServices.Persistence import DocumentManager

Inpt = UnwrapElement(IN[0])
ItmList = list()

Doc = DocumentManager.Instance.CurrentDBDocument

Config = FabricationConfiguration.GetFabricationConfiguration(Doc)

for Item in Inpt:
	SpecName = Config.GetSpecificationName(Item)
	ItmList.append(SpecName)

OUT = ItmList
# ----------------------------------------
Spec_Name = Output(fabrication_specification_name)
fabrication_specification = Python(IN[0]=flatten)  # "Fabrication Specification Abbreviation"
# ---------- fabrication_specification.python (23 lines) ----------
#Copyright(c) 2016, Nathan Chapman
# nchapman@generalheating.com

import clr
clr.AddReference("RevitAPI")
import Autodesk
from Autodesk.Revit.DB import FabricationConfiguration
clr.AddReference("RevitServices")
import RevitServices
from RevitServices.Persistence import DocumentManager

Inpt = UnwrapElement(IN[0])
ItmList = list()

Doc = DocumentManager.Instance.CurrentDBDocument

Config = FabricationConfiguration.GetFabricationConfiguration(Doc)

for Item in Inpt:
	SpecAbrn = Config.GetSpecificationAbbreviation(Item)
	ItmList.append(SpecAbrn)

OUT = ItmList
# ----------------------------------------
Spec_Abbreviation = Output(fabrication_specification)
