# Dynamo custom node Import Fabrication Job.dyf (Dynamo 1.0.0.1180)
# category: DynaFabrication2017.Util
# Import MAJ file

string = StringInput("CustomCtrl_%CustomCtrl_%CustomCtrl_%Add-Ins%Revit Extension for Fabrication%PulldownGroup%Import Autodesk Fabrication Job File")
external_command = Python(IN[0]=string)
# ---------- external_command.python (30 lines) ----------
#Copyright(c) 2016, Nathan Chapman
# nchapman@generalheating.com

import clr
clr.AddReference("RevitAPI")
clr.AddReference('RevitAPIUI')
import Autodesk
from Autodesk.Revit.UI import RevitCommandId
from Autodesk.Revit.UI import UIApplication
from Autodesk.Revit.UI import ExternalCommandData
clr.AddReference("RevitServices")
import RevitServices
from RevitServices.Persistence import DocumentManager
from RevitServices.Transactions import TransactionManager

Doc = DocumentManager.Instance.CurrentDBDocument
App =  DocumentManager.Instance.CurrentUIApplication

ItmList = list()
ItmList1 = list()
Inpt = IN[0]

CmmdID= RevitCommandId.LookupCommandId(Inpt)
CmId = CmmdID.Id
App.PostCommand(CmmdID)

ItmList.append(CmmdID)
ItmList1.append(CmId)

OUT = ItmList, ItmList1
# ----------------------------------------
