# Dynamo custom node Journal File Comment.dyf (Dynamo 1.0.0.1180)
# category: DynaFabrication2017.Util
# Add a comment to the journal file

String = Input()
bool = Input()
journal_file_comment = Python(IN[0]=String, IN[1]=bool)
# ---------- journal_file_comment.python (16 lines) ----------
#Copyright(c) 2016, Nathan Chapman
# nchapman@generalheating.com

import clr
clr.AddReference("RevitServices")
import RevitServices
from RevitServices.Persistence import DocumentManager

Strng = UnwrapElement(IN[0])
TmeSmp = UnwrapElement(IN[1])


Doc = DocumentManager.Instance.CurrentDBDocument
UiApp = DocumentManager.Instance.CurrentUIApplication
App = UiApp.Application
App.WriteJournalComment(Strng, TmeSmp)
# ----------------------------------------
