# Dynamo custom node Load Fabrication Service(s).dyf (Dynamo 1.0.0.1180)
# category: DynaFabrication2017.Configuration
# Load fabrication service(s) into document

Service_s_ID = Input()  # "Service(s) ID"
fabrication_load_service_s = Python(IN[0]=Service_s_ID)
# ---------- fabrication_load_service_s.python (26 lines) ----------
#Copyright(c) 2016, Nathan Chapman
# nchapman@generalheating.com

import clr
clr.AddReference("RevitAPI")
import Autodesk
from Autodesk.Revit.DB import FabricationConfiguration
clr.AddReference("RevitServices")
import RevitServices
from RevitServices.Persistence import DocumentManager
from RevitServices.Transactions import TransactionManager

Inpt = UnwrapElement(IN[0])
ItmList = list()

Doc = DocumentManager.Instance.CurrentDBDocument
TransactionManager.Instance.EnsureInTransaction(Doc)

Config = FabricationConfiguration.GetFabricationConfiguration(Doc)
Config.ReloadConfiguration()
LServices = Config.LoadServices(Inpt)
ItmList.append(LServices)

TransactionManager.Instance.TransactionTaskDone()

OUT = ItmList
# ----------------------------------------
Service_s_Loaded = Output(fabrication_load_service_s)  # "Service(s) Loaded"
