# Dynamo custom node Loaded Applications.dyf (Dynamo 1.0.0.1180)
# category: DynaFabrication2017.Util
# Get all loaded applications

loaded_applicaitons = Python()
# ---------- loaded_applicaitons.python (32 lines) ----------
#Copyright(c) 2016, Nathan Chapman
# nchapman@generalheating.com

import clr
clr.AddReference("RevitAPI")
clr.AddReference('RevitAPIUI')
import Autodesk
from Autodesk.Revit.DB import FabricationConfiguration
from Autodesk.Revit.UI import RevitCommandId
from Autodesk.Revit.UI import UIApplication
clr.AddReference("RevitServices")
import RevitServices
from RevitServices.Persistence import DocumentManager
ItmList = list()
ItmList1 = list()
ItmList2 = list()
ItmList3 = list()

Doc = DocumentManager.Instance.CurrentDBDocument
App =  DocumentManager.Instance.CurrentUIApplication.LoadedApplications
ItmList.append(App)

for Item in App:
	Typ = Item.GetType()
	NmSpc = Typ.Namespace
	ItmList1.append(NmSpc)
	Nme = Typ.Name
	ItmList2.append(Nme)
	Assbly = Typ.Assembly
	ItmList3.append(Assbly)

OUT = ItmList, ItmList1, ItmList2, ItmList3
# ----------------------------------------
code_block = CodeBlock(seq=loaded_applicaitons) { seq[0]; seq[1]; seq[2]; seq[3]; }
Name = Output(code_block.out2)
NameSpace = Output(code_block.out1)
Application = Output(code_block.out0)
Assembly = Output(code_block.out3)
