# Dynamo custom node Optimize Fabrication Part(s) Length.dyf (Dynamo 1.0.0.1180)
# category: DynaFabrication2017.Parts
# Optimize fabrication part(s) Length

Fab_ID_s = Input()  # "Fab ID(s)"
flatten = Flatten(Fab_ID_s)
python_script = Python(IN[0]=flatten)
# ---------- python_script.python (23 lines) ----------
import clr
clr.AddReference('RevitAPI')
from Autodesk.Revit.DB import *

clr.AddReference("RevitNodes")
import Revit
clr.ImportExtensions(Revit.Elements)

clr.AddReference("RevitServices")
import RevitServices
from RevitServices.Persistence import DocumentManager

doc = DocumentManager.Instance.CurrentDBDocument
items = UnwrapElement(IN[0])

elementlist = list()
unmatched = list()
for item in items:
	try: 
		elementlist.append(doc.GetElement(item).ToDSType(True))
	except:
		unmatched.append(item)
OUT = elementlist
# ----------------------------------------
count = Count(python_script)
fabrication_optimize_length = Python(IN[0]=python_script, IN[1]=count)
# ---------- fabrication_optimize_length.python (44 lines) ----------
#Copyright(c) 2016, Nathan Chapman
# nchapman@generalheating.com

import clr
import System
clr.AddReference("System.Core")
from System.Collections.Generic import HashSet

import clr
clr.AddReference('RevitAPI')
from Autodesk.Revit.DB import *

clr.AddReference("RevitNodes")
import Revit
import Autodesk
clr.ImportExtensions(Revit.Elements)

clr.AddReference("RevitServices")
import RevitServices
from RevitServices.Persistence import DocumentManager
from RevitServices.Transactions import TransactionManager
Doc = DocumentManager.Instance.CurrentDBDocument

PartsId = UnwrapElement(IN[0])
Cnt= UnwrapElement(IN[1])
OptPart = list()
MyHashSet = HashSet[Autodesk.Revit.DB.ElementId]()

TransactionManager.Instance.EnsureInTransaction(Doc)

if Cnt > 1: 
	for Item in PartsId:
		if Item.IsAStraight():
			MyHashSet.Add(Item.Id)
			Item.OptimizeLengths(Doc, MyHashSet)

else:
	if PartsId.IsAStraight():
		MyHashSet.Add(PartsId.Id)
		PartsId.OptimizeLengths(Doc, MyHashSet)

TransactionManager.Instance.TransactionTaskDone()

OUT = MyHashSet
# ----------------------------------------
ID_s = Output(fabrication_optimize_length)  # "ID(s)"
