# Dynamo custom node Part(s) Current Product List Entry.dyf (Dynamo 1.0.0.1180)
# category: DynaFabrication2017.Parts
# Get the current Product list entry for the part(s)

Item_s = Input()  # "Item(s)"
fabrication_part_product_entry = Python(IN[0]=Item_s)
# ---------- fabrication_part_product_entry.python (20 lines) ----------
#Copyright(c) 2016, Nathan Chapman
# nchapman@generalheating.com

import clr
clr.AddReference('RevitAPI')
from Autodesk.Revit.DB import *

clr.AddReference("RevitNodes")
import Revit
clr.ImportExtensions(Revit.Elements)

FabricationParts = UnwrapElement(IN[0])
functionlist = list()

for item in FabricationParts:
	try:
		functionlist.append(item.get_Parameter(BuiltInParameter.FABRICATION_PRODUCT_ENTRY).AsString())
	except:
		functionlist.append('No Value')
OUT = functionlist
# ----------------------------------------
Product_List_Name = Output(fabrication_part_product_entry)
count = Count(Item_s)
fabrication_part_product_entry_2 = Python(IN[0]=Item_s, IN[1]=count)
# ---------- fabrication_part_product_entry_2.python (28 lines) ----------
#Copyright(c) 2016, Nathan Chapman
# nchapman@generalheating.com

import clr
clr.AddReference('RevitAPI')
from Autodesk.Revit.DB import *
import clr
clr.AddReference("RevitAPI")
import Autodesk
from Autodesk.Revit.DB import FabricationPart

clr.AddReference("RevitNodes")
import Revit
clr.ImportExtensions(Revit.Elements)

Inpt = UnwrapElement(IN[0])
Cnt = UnwrapElement(IN[1])
ItmList = list()

if Cnt > 1:
	for Item in Inpt:
		CID = Item.ProductListEntry
		ItmList.append(CID)
else:
	CID = Inpt.ProductListEntry
	ItmList.append(CID)

OUT = ItmList
# ----------------------------------------
Product_List_Index = Output(fabrication_part_product_entry_2)
