# Dynamo custom node Reposition Fabrication Part.dyf (Dynamo 1.0.0.1180)
# category: DynaFabrication2017.Parts
# Swaps selected end part with opposite end part.

Input = Input()
count = Count(Input)
fabrication_reposition = Python(IN[0]=Input, IN[1]=count)
# ---------- fabrication_reposition.python (39 lines) ----------
#Copyright(c) 2016, Nathan Chapman
# nchapman@generalheating.com

import clr
clr.AddReference('RevitAPI')
from Autodesk.Revit.DB import *
import clr
clr.AddReference("RevitAPI")
import Autodesk
from Autodesk.Revit.DB import FabricationPart

clr.AddReference("RevitNodes")
import Revit
clr.ImportExtensions(Revit.Elements)

clr.AddReference("RevitServices")
import RevitServices
from RevitServices.Persistence import DocumentManager
from RevitServices.Transactions import TransactionManager
clr.ImportExtensions(Revit.GeometryConversion)

FabricationParts = UnwrapElement(IN[0])
Cnt= UnwrapElement(IN[1])
functionlist = list()

Doc = DocumentManager.Instance.CurrentDBDocument
TransactionManager.Instance.EnsureInTransaction(Doc)

if Cnt > 1:
	for Item in FabricationParts:
		Item.Reposition(Doc, FabricationParts.Id)
		functionlist.append(FabricationParts.Id)
else:
		FabricationParts.Reposition(Doc, FabricationParts.Id)
		functionlist.append(FabricationParts.Id)
		
TransactionManager.Instance.TransactionTaskDone()

OUT = functionlist
# ----------------------------------------
ID = Output(fabrication_reposition)
