# Dynamo custom node RevitLookup Snoop Application.dyf (Dynamo 1.0.0.1180)
# category: DynaFabrication2017.Util
# Using RevitLookup, snoop Revit's application.  RevitLookup must be installed for this to work. If node doesnt work execute the button manualy and look in the journal file.  You will see something like this J   Jrn.RibbonEvent "Execute external command:CustomCtrl_%CustomCtrl_%CustomCtrl_%Add-Ins%Revit Lookup%Options%Snoop Current Selection...:RevitLookup.CmdSnoopModScope". Take inbetween the first : and next : and put in string in node.

string = StringInput("CustomCtrl_%CustomCtrl_%CustomCtrl_%Add-Ins%Revit Lookup%Options%Snoop Current Selection...")
element_s = Input()  # "element(s)"
reset = Input(reset:bool = true)
python_script = Python(IN[0]=element_s, IN[1]=reset)
# ---------- python_script.python (49 lines) ----------
#Copyright(c) 2016, Dimitar Venkov
# @5devene, dimitar.ven@gmail.com
#inspired by Julien Benoit @jbenoit44 
#http://aecuandme.wordpress.com/

import clr

clr.AddReference("RevitServices")
import RevitServices
from RevitServices.Persistence import DocumentManager
from RevitServices.Transactions import TransactionManager
doc = DocumentManager.Instance.CurrentDBDocument
app = DocumentManager.Instance.CurrentUIApplication.Application
uidoc=DocumentManager.Instance.CurrentUIApplication.ActiveUIDocument

clr.AddReference("RevitNodes")
import Revit
clr.ImportExtensions(Revit.Elements)

clr.AddReference("RevitAPI")
from Autodesk.Revit.DB import ElementId
clr.AddReference("RevitAPIUI")
from Autodesk.Revit.UI.Selection import *

clr.AddReference("System")
from System.Collections.Generic import List as cList

def tolist(obj1):
	if hasattr(obj1,"__iter__"): return obj1
	else: return [obj1]

elements = UnwrapElement(tolist(IN[0]))

if "2014" in app.VersionName :
	TransactionManager.Instance.EnsureInTransaction(doc)
	sel1  = uidoc.Selection.Elements
	for i in xrange(len(elements)): 
		try:(sel1.Add(elements[i]))
		except: pass
	OUT = "%s elements selected in Revit." %sel1.Size
	TransactionManager.Instance.TransactionTaskDone()
else:
	ids1 = []
	for i in xrange(len(elements)):
		try:(ids1.append(elements[i].Id))
		except: pass
	ids2 = cList[ElementId](ids1)
	uidoc.Selection.SetElementIds(ids2)
	OUT = "%s elements selected in Revit." %ids2.Count
# ----------------------------------------
count = Count(python_script)
external_command = Python(IN[0]=string, IN[1]=count)
# ---------- external_command.python (35 lines) ----------
#Copyright(c) 2016, Nathan Chapman
# nchapman@generalheating.com

import clr
clr.AddReference("RevitAPI")
clr.AddReference('RevitAPIUI')
import Autodesk
from Autodesk.Revit.UI import RevitCommandId
from Autodesk.Revit.UI import UIApplication
from Autodesk.Revit.UI import ExternalCommandData
clr.AddReference("RevitServices")
import RevitServices
from RevitServices.Persistence import DocumentManager
from RevitServices.Transactions import TransactionManager

Doc = DocumentManager.Instance.CurrentDBDocument
App =  DocumentManager.Instance.CurrentUIApplication

ItmList = list()
ItmList1 = list()
Inpt = IN[0]
Cnt = IN[1]

if Cnt > 0:
	CmmdID= RevitCommandId.LookupCommandId(Inpt)
	CmId = CmmdID.Id
	App.PostCommand(CmmdID)
	
	ItmList.append(CmmdID)
	ItmList1.append(CmId)
else:
	ItmList.append("No Item(s) selected")
	ItmList1.append("No Item(s) selected")

OUT = ItmList, ItmList1
# ----------------------------------------
