# Dynamo custom node Rotate Part By Connector.dyf (Dynamo 1.0.0.1180)
# category: DynaFabrication2017.Parts
# Rotates part about connector a specified angle. Rectangular/Oval angles are limited to 90,180,270. Taps can't be rotated.

Input_s = Input()  # "Input(s)"
Connector = Input()
Angle = Input()
degreesToRadians = Math.DegreesToRadians(Angle)
count = Count(Input_s)
fabrication_rotate_postion_by = Python(IN[0]=Input_s, IN[1]=Connector, IN[2]=degreesToRadians, IN[3]=count)  # "Fabrication Rotate Postion by Angle"
# ---------- fabrication_rotate_postion_by.python (37 lines) ----------
#Copyright(c) 2016, Nathan Chapman
# nchapman@generalheating.com

import clr
clr.AddReference('RevitAPI')
from Autodesk.Revit.DB import *
import clr
clr.AddReference("RevitAPI")
import Autodesk
from Autodesk.Revit.DB import FabricationPart

clr.AddReference("RevitNodes")
import Revit
clr.ImportExtensions(Revit.Elements)

clr.AddReference("RevitServices")
import RevitServices
from RevitServices.Persistence import DocumentManager
from RevitServices.Transactions import TransactionManager
clr.ImportExtensions(Revit.GeometryConversion)

FabricationParts = UnwrapElement(IN[0])
Conn = UnwrapElement(IN[1])
Ang = UnwrapElement(IN[2])
Cnt= UnwrapElement(IN[3])
functionlist = list()

Doc = DocumentManager.Instance.CurrentDBDocument
TransactionManager.Instance.EnsureInTransaction(Doc)

if Cnt > 1:
	for Item in FabricationParts:
		functionlist.append(Item.RotateConnectedPartByConnector(Doc, Conn, Ang))
else:
		functionlist.append(FabricationParts.RotateConnectedPartByConnector(Doc, Conn, Ang))
		
TransactionManager.Instance.TransactionTaskDone()
# ----------------------------------------
Output = Output(fabrication_rotate_postion_by)  # ""
