# Dynamo custom node Rotate Tap By Connector.dyf (Dynamo 1.0.0.1180)
# category: DynaFabrication2017.Parts
# Rotate a tap about a connector

Input_s = Input()  # "Input(s)"
Primary_Angle = Input()
degreesToRadians = Math.DegreesToRadians(Primary_Angle)
Secondary_Angle = Input()
degreesToRadians_2 = Math.DegreesToRadians(Secondary_Angle)
count = Count(Input_s)
fabrication_rotate_postion_by = Python(IN[0]=Input_s, IN[1]=degreesToRadians, IN[2]=degreesToRadians_2, IN[3]=count)  # "Fabrication Rotate Postion by Angle"
# ---------- fabrication_rotate_postion_by.python (37 lines) ----------
#Copyright(c) 2016, Nathan Chapman
# nchapman@generalheating.com

import clr
clr.AddReference('RevitAPI')
from Autodesk.Revit.DB import *
import clr
clr.AddReference("RevitAPI")
import Autodesk
from Autodesk.Revit.DB import FabricationPart

clr.AddReference("RevitNodes")
import Revit
clr.ImportExtensions(Revit.Elements)

clr.AddReference("RevitServices")
import RevitServices
from RevitServices.Persistence import DocumentManager
from RevitServices.Transactions import TransactionManager
clr.ImportExtensions(Revit.GeometryConversion)

FabricationParts = UnwrapElement(IN[0])
AngPri = UnwrapElement(IN[1])
AngSec = UnwrapElement(IN[2])
Cnt= UnwrapElement(IN[3])
functionlist = list()

Doc = DocumentManager.Instance.CurrentDBDocument
TransactionManager.Instance.EnsureInTransaction(Doc)

if Cnt > 1:
	for Item in FabricationParts:	
		functionlist.append(Item.RotateConnectedTap(Doc, FabricationParts, AngPri, AngSec))
else:		
		functionlist.append(FabricationParts.RotateConnectedTap(Doc, FabricationParts, AngPri, AngSec))
		
TransactionManager.Instance.TransactionTaskDone()
# ----------------------------------------
Output = Output(fabrication_rotate_postion_by)  # ""
