# Dynamo custom node Set Fabrication Position By End.dyf (Dynamo 1.0.0.1180)
# category: DynaFabrication2017.Parts
# Sets fabrication part bases of connector

Input_s = Input()  # "Input(s)"
Connector = Input()
Point = Input()
count = Count(Input_s)
fabrication_set_postion_by_end = Python(IN[0]=Input_s, IN[1]=Connector, IN[2]=Point, IN[3]=count)
# ---------- fabrication_set_postion_by_end.python (39 lines) ----------
#Copyright(c) 2016, Nathan Chapman
# nchapman@generalheating.com

import clr
clr.AddReference('RevitAPI')
from Autodesk.Revit.DB import *
import clr
clr.AddReference("RevitAPI")
import Autodesk
from Autodesk.Revit.DB import FabricationPart

clr.AddReference("RevitNodes")
import Revit
clr.ImportExtensions(Revit.Elements)

clr.AddReference("RevitServices")
import RevitServices
from RevitServices.Persistence import DocumentManager
from RevitServices.Transactions import TransactionManager
clr.ImportExtensions(Revit.GeometryConversion)

FabricationParts = UnwrapElement(IN[0])
Conn = UnwrapElement(IN[1])
Orig = UnwrapElement(IN[2]).ToXyz()
Cnt= UnwrapElement(IN[3])
functionlist = list()

Doc = DocumentManager.Instance.CurrentDBDocument
TransactionManager.Instance.EnsureInTransaction(Doc)

if Cnt > 1:
	for Item in FabricationParts:	
		functionlist.append(Item.SetPositionByEnd(Conn, Orig))
else:		
		functionlist.append(FabricationParts.SetPositionByEnd(Conn, Orig))
		
TransactionManager.Instance.TransactionTaskDone()

OUT = functionlist
# ----------------------------------------
Output = Output(fabrication_set_postion_by_end)  # ""
