# Dynamo custom node Set Fabrication Specification.dyf (Dynamo 1.0.0.1180)
# category: DynaFabrication2017.Parts
# Sets the fabrication specification based on ID

Input = Input()
string = StringInput("Specification")
Spec_ID = Input()
setParameterByName = Element.SetParameterByName(element=Input, parameterName=string, value=Spec_ID)
count = Count(Input)
fabrication_set_specification = Python(IN[0]=setParameterByName, IN[1]=count)
# ---------- fabrication_set_specification.python (35 lines) ----------
#Copyright(c) 2016, Nathan Chapman
# nchapman@generalheating.com
import clr
clr.AddReference('RevitAPI')
from Autodesk.Revit.DB import *
clr.AddReference("RevitNodes")
import Revit
clr.ImportExtensions(Revit.Elements)
clr.AddReference("RevitServices")
import RevitServices
from RevitServices.Persistence import DocumentManager
from RevitServices.Transactions import TransactionManager

Doc = DocumentManager.Instance.CurrentDBDocument

FabricationParts = UnwrapElement(IN[0])
Cnt= UnwrapElement(IN[1])
functionlist = list()

TransactionManager.Instance.EnsureInTransaction(Doc)
if Cnt > 1:
	for Item in FabricationParts:
		try:
			functionlist.append(Item.get_Parameter(BuiltInParameter.FABRICATION_SPECIFICATION).AsInteger())
		except:
			functionlist.append('No Specification')
else:
		try:
			functionlist.append(FabricationParts.get_Parameter(BuiltInParameter.FABRICATION_SPECIFICATION).AsInteger())
		except:
			functionlist.append('No Specification')
			
TransactionManager.Instance.TransactionTaskDone()

OUT = functionlist
# ----------------------------------------
Spec_ID_2 = Output(fabrication_set_specification)  # "Spec ID"
