# Dynamo custom node Set Library Path(s).dyf (Dynamo 1.0.0.1180)
# category: DynaFabrication2017.Util
# Set the library path(s)

Diretory = Input()
Library_Name = Input()
Diretory_2 = Input(Diretory)
Library_Name_2 = Input(Library Name)
set_library_paths = Python(IN[0]=Diretory, IN[1]=Library_Name, IN[2]=Diretory_2, IN[3]=Library_Name_2)
# ---------- set_library_paths.python (26 lines) ----------
#Copyright(c) 2016, Nathan Chapman
# nchapman@generalheating.com

import clr
clr.AddReference("RevitServices")
import RevitServices
from RevitServices.Persistence import DocumentManager
clr.AddReference("System.Core")
import System
from System.Collections.Generic import Dictionary

Pth = UnwrapElement(IN[0])
PthKey = UnwrapElement(IN[1])
Pth1 = UnwrapElement(IN[2])
Pth1Key = UnwrapElement(IN[3])

Doc = DocumentManager.Instance.CurrentDBDocument
UiApp = DocumentManager.Instance.CurrentUIApplication
App = UiApp.Application

Dict = Dictionary[str,str]()
Dict.Add(PthKey,Pth)
Dict.Add(Pth1Key,Pth1)
App.SetLibraryPaths(Dict)

OUT = Dict
# ----------------------------------------
Path_s = Output(set_library_paths)  # "Path(s)"
