# Dynamo custom node Set Shared Parameter File.dyf (Dynamo 1.0.0.1180)
# category: DynaFabrication2017.Util
# Set the shared parameter file

FilePath = Input()
set_shared_parameter_file = Python(IN[0]=FilePath)
# ---------- set_shared_parameter_file.python (21 lines) ----------
#Copyright(c) 2016, Nathan Chapman
# nchapman@generalheating.com

import clr
clr.AddReference("RevitServices")
import RevitServices
from RevitServices.Persistence import DocumentManager
from RevitServices.Transactions import TransactionManager

Fle = IN[0]
ItmList = list()

Doc = DocumentManager.Instance.CurrentDBDocument
UiApp = DocumentManager.Instance.CurrentUIApplication
App = UiApp.Application
TransactionManager.Instance.EnsureInTransaction(Doc)
App.SharedParametersFilename = Fle
ItmList.append(Fle)
TransactionManager.Instance.TransactionTaskDone()

OUT = ItmList
# ----------------------------------------
File = Output(set_shared_parameter_file)
