# Dynamo custom node Unload Fabrication Service(s).dyf (Dynamo 1.0.0.1180)
# category: DynaFabrication2017.Configuration
# Unload fabrication service(s) from document

Service_s_ID = Input()  # "Service(s) ID"
fabrication_unload_service_s = Python(IN[0]=Service_s_ID)
# ---------- fabrication_unload_service_s.python (26 lines) ----------
#Copyright(c) 2016, Nathan Chapman
# nchapman@generalheating.com

import clr
clr.AddReference("RevitAPI")
import Autodesk
from Autodesk.Revit.DB import FabricationConfiguration
clr.AddReference("RevitServices")
import RevitServices
from RevitServices.Persistence import DocumentManager
from RevitServices.Transactions import TransactionManager

Inpt = UnwrapElement(IN[0])
ItmList= list()

Doc = DocumentManager.Instance.CurrentDBDocument
TransactionManager.Instance.EnsureInTransaction(Doc)

Config = FabricationConfiguration.GetFabricationConfiguration(Doc)
Config.ReloadConfiguration()
UnLServices = Config.UnloadServices(Inpt)
ItmList.append(Inpt)

TransactionManager.Instance.TransactionTaskDone()

OUT = ItmList
# ----------------------------------------
fabrication_service_s_id = Python(IN[0]=Service_s_ID)
# ---------- fabrication_service_s_id.python (18 lines) ----------
#Copyright(c) 2016, Nathan Chapman
# nchapman@generalheating.com

import clr
clr.AddReference("RevitAPI")
import Autodesk
from Autodesk.Revit.DB import FabricationConfiguration
clr.AddReference("RevitServices")
import RevitServices
from RevitServices.Persistence import DocumentManager
from RevitServices.Transactions import TransactionManager

Inpt = UnwrapElement(IN[0])
ItmList = list()

ItmList.append(Inpt)

OUT = ItmList
# ----------------------------------------
Service_s_ID_Removed = Output(fabrication_service_s_id)  # "Service(s) ID Removed"
