# Dynamo custom node Connector(s) Information.dyf (Dynamo 1.3.0.875)
# category: DynaFabrication2018.Parts
# Gets the connector(s) information.

Item_s = Input()  # "Item(s)"
code_block = CodeBlock(item=Item_s) { Flatten({item}); }
part_connector = Python(IN[0]=code_block)
# ---------- part_connector.python (21 lines) ----------
#Copyright(c) 2017, Nathan Chapman
# nchapman@generalheating.com

import clr
clr.AddReference('RevitAPI')
import Autodesk
from Autodesk.Revit.DB import FabricationPart
from Autodesk.Revit.DB import FabricationConfiguration

Inpt = []
ItmList = list()

for i in IN[0]:
	Inpt.append(UnwrapElement(i))
	
for e in Inpt:
	CM = e.ConnectorManager
	Conn = CM.Connectors
	ItmList.append(Conn)

OUT = ItmList
# ----------------------------------------
code_block_2 = CodeBlock(item=part_connector) { Flatten({item}); }
part_connectorinfo_id = Python(IN[0]=code_block_2)
# ---------- part_connectorinfo_id.python (27 lines) ----------
#Copyright(c) 2017, Nathan Chapman
# nchapman@generalheating.com

import clr
clr.AddReference('RevitAPI')
import Autodesk
from Autodesk.Revit.DB import FabricationPart
from Autodesk.Revit.DB import FabricationConfiguration

Inpt = []
Inpt1 = []
ItmList = list()

for i in IN[0]:
	Inpt.append(UnwrapElement(i))
	
for e in Inpt:
	ConnInfo = e.GetFabricationConnectorInfo()

	Inpt1.append(ConnInfo)

for n in Inpt1:
	ConnId = n.BodyConnectorId

	ItmList.append(ConnId)
	
OUT = ItmList
# ----------------------------------------
part_connector_name = Python(IN[0]=part_connectorinfo_id)
# ---------- part_connector_name.python (28 lines) ----------
#Copyright(c) 2017, Nathan Chapman
# nchapman@generalheating.com

import clr
clr.AddReference('RevitAPI')
import Autodesk
from Autodesk.Revit.DB import FabricationPart
from Autodesk.Revit.DB import FabricationConfiguration

clr.AddReference("RevitServices")
import RevitServices
from RevitServices.Persistence import DocumentManager

Inpt = []
ItmList = list()
Doc = DocumentManager.Instance.CurrentDBDocument

Config = FabricationConfiguration.GetFabricationConfiguration(Doc)

for i in IN[0]:
	Inpt.append(UnwrapElement(i))
	
for e in Inpt:
	ConnName = Config.GetFabricationConnectorName(e)

	ItmList.append(ConnName)

OUT = ItmList
# ----------------------------------------
count = List.Count(part_connector@L2)
chop = List.Chop(list=part_connector_name, lengths=count)
Connector_Name = Output(chop)
part_connector_domain = Python(IN[0]=part_connectorinfo_id)
# ---------- part_connector_domain.python (28 lines) ----------
#Copyright(c) 2017, Nathan Chapman
# nchapman@generalheating.com

import clr
clr.AddReference('RevitAPI')
import Autodesk
from Autodesk.Revit.DB import FabricationPart
from Autodesk.Revit.DB import FabricationConfiguration

clr.AddReference("RevitServices")
import RevitServices
from RevitServices.Persistence import DocumentManager

Inpt = []
ItmList = list()
Doc = DocumentManager.Instance.CurrentDBDocument

Config = FabricationConfiguration.GetFabricationConfiguration(Doc)

for i in IN[0]:
	Inpt.append(UnwrapElement(i))
	
for e in Inpt:
	ConnName = Config.GetFabricationConnectorDomain(e)

	ItmList.append(ConnName)

OUT = ItmList
# ----------------------------------------
chop_2 = List.Chop(list=part_connector_domain, lengths=count)
Connector_Domain = Output(chop_2)
part_connector_shape = Python(IN[0]=part_connectorinfo_id)
# ---------- part_connector_shape.python (28 lines) ----------
#Copyright(c) 2017, Nathan Chapman
# nchapman@generalheating.com

import clr
clr.AddReference('RevitAPI')
import Autodesk
from Autodesk.Revit.DB import FabricationPart
from Autodesk.Revit.DB import FabricationConfiguration

clr.AddReference("RevitServices")
import RevitServices
from RevitServices.Persistence import DocumentManager

Inpt = []
ItmList = list()
Doc = DocumentManager.Instance.CurrentDBDocument

Config = FabricationConfiguration.GetFabricationConfiguration(Doc)

for i in IN[0]:
	Inpt.append(UnwrapElement(i))
	
for e in Inpt:
	ConnName = Config.GetFabricationConnectorShape(e)

	ItmList.append(ConnName)

OUT = ItmList
# ----------------------------------------
chop_3 = List.Chop(list=part_connector_shape, lengths=count)
Connector_Shape = Output(chop_3)
part_connector_group = Python(IN[0]=part_connectorinfo_id)
# ---------- part_connector_group.python (28 lines) ----------
#Copyright(c) 2017, Nathan Chapman
# nchapman@generalheating.com

import clr
clr.AddReference('RevitAPI')
import Autodesk
from Autodesk.Revit.DB import FabricationPart
from Autodesk.Revit.DB import FabricationConfiguration

clr.AddReference("RevitServices")
import RevitServices
from RevitServices.Persistence import DocumentManager

Inpt = []
ItmList = list()
Doc = DocumentManager.Instance.CurrentDBDocument

Config = FabricationConfiguration.GetFabricationConfiguration(Doc)

for i in IN[0]:
	Inpt.append(UnwrapElement(i))
	
for e in Inpt:
	ConnName = Config.GetFabricationConnectorGroup(e)

	ItmList.append(ConnName)

OUT = ItmList
# ----------------------------------------
chop_4 = List.Chop(list=part_connector_group, lengths=count)
Connector_Group = Output(chop_4)
