# Dynamo custom node Get All Fabrication Configuration(s).dyf (Dynamo 1.3.0.875)
# category: DynaFabrication2018.Configuration
# Gets all the fabrication configurations in the current document.

get_all_fabrication = Python()  # "Get All Fabrication Configuration(s)"
# ---------- get_all_fabrication.python (21 lines) ----------
#Copyright(c) 2017, Nathan Chapman
# nchapman@generalheating.com

import clr
clr.AddReference("RevitAPI")
import Autodesk
from Autodesk.Revit.DB import FabricationConfiguration
clr.AddReference("RevitServices")
import RevitServices
from RevitServices.Persistence import DocumentManager

Doc = DocumentManager.Instance.CurrentDBDocument

ItmList = list()

ConfigName = FabricationConfiguration.GetFabricationConfiguration(Doc)
ConfigInfo = ConfigName.GetFabricationConfigurationInfo()
test = ConfigInfo.GetAllFabricationConfigurations()
ItmList.append(test)

OUT = ItmList
# ----------------------------------------
flatten = Flatten(get_all_fabrication)
config_name = Python(IN[0]=flatten)
# ---------- config_name.python (12 lines) ----------
import clr
clr.AddReference('RevitAPI')
from Autodesk.Revit.DB import *

faminsts = UnwrapElement(IN[0])
elementlist = list()
for item in faminsts:
	try:
		elementlist.append(item.Name)
	except:
		elementlist.append(list())
OUT = elementlist
# ----------------------------------------
Config_Name = Output(config_name)
Config_Info = Output(flatten)
