# Dynamo custom node Get All Fabrication Dampers.dyf (Dynamo 1.3.0.875)
# category: DynaFabrication2018.Configuration

fabrication_dampers_all = Python()
# ---------- fabrication_dampers_all.python (20 lines) ----------
#Copyright(c) 2017, Nathan Chapman
# nchapman@generalheating.com

import clr
clr.AddReference("RevitAPI")
import Autodesk
from Autodesk.Revit.DB import FabricationConfiguration
clr.AddReference("RevitServices")
import RevitServices
from RevitServices.Persistence import DocumentManager

Doc = DocumentManager.Instance.CurrentDBDocument

ItmList = list()

Config = FabricationConfiguration.GetFabricationConfiguration(Doc)
AllDampers = Config.GetAllDampers()
ItmList.append(AllDampers)

OUT = ItmList
# ----------------------------------------
code_block = CodeBlock(item=fabrication_dampers_all) { Flatten({item}); }
damper_name = Python(IN[0]=code_block)
# ---------- damper_name.python (27 lines) ----------
#Copyright(c) 2017, Nathan Chapman
# nchapman@generalheating.com

import clr
clr.AddReference('RevitAPI')
import Autodesk
from Autodesk.Revit.DB import FabricationPart
from Autodesk.Revit.DB import FabricationConfiguration

clr.AddReference("RevitServices")
import RevitServices
from RevitServices.Persistence import DocumentManager

Inpt = []
ItmList = list()
Doc = DocumentManager.Instance.CurrentDBDocument

Config = FabricationConfiguration.GetFabricationConfiguration(Doc)

for i in IN[0]:
	Inpt.append(UnwrapElement(i))
	
for e in Inpt:
	STName = Config.GetDamperName(e)
	ItmList.append(STName)

OUT = ItmList
# ----------------------------------------
Damper_Name = Output(damper_name)
