# Dynamo custom node Get All Part Statuses.dyf (Dynamo 1.3.0.875)
# category: DynaFabrication2018.Configuration
# Gets Fabrication part statuses from database

fabrication_statuses_all = Python()
# ---------- fabrication_statuses_all.python (20 lines) ----------
#Copyright(c) 2017, Nathan Chapman
# nchapman@generalheating.com

import clr
clr.AddReference("RevitAPI")
import Autodesk
from Autodesk.Revit.DB import FabricationConfiguration
clr.AddReference("RevitServices")
import RevitServices
from RevitServices.Persistence import DocumentManager

Doc = DocumentManager.Instance.CurrentDBDocument

ItmList = list()

Config = FabricationConfiguration.GetFabricationConfiguration(Doc)
AllStatuses = Config.GetAllPartStatuses()
ItmList.append(AllStatuses)

OUT = ItmList
# ----------------------------------------
code_block = CodeBlock(item=fabrication_statuses_all) { Flatten({item}); }
part_statuses = Python(IN[0]=code_block)
# ---------- part_statuses.python (27 lines) ----------
#Copyright(c) 2017, Nathan Chapman
# nchapman@generalheating.com

import clr
clr.AddReference('RevitAPI')
import Autodesk
from Autodesk.Revit.DB import FabricationPart
from Autodesk.Revit.DB import FabricationConfiguration

clr.AddReference("RevitServices")
import RevitServices
from RevitServices.Persistence import DocumentManager

Inpt = []
ItmList = list()
Doc = DocumentManager.Instance.CurrentDBDocument

Config = FabricationConfiguration.GetFabricationConfiguration(Doc)

for i in IN[0]:
	Inpt.append(UnwrapElement(i))
	
for e in Inpt:
	STName = Config.GetPartStatusDescription(e)
	ItmList.append(STName)

OUT = ItmList
# ----------------------------------------
Status_Name = Output(part_statuses)
