# Dynamo custom node Get Fabrication Configuration Info.dyf (Dynamo 1.3.0.875)
# category: DynaFabrication2018.Configuration
# Get loaded fabriation configuration information (Name, Path and Profile)

fabrication_configuration = Python()
# ---------- fabrication_configuration.python (30 lines) ----------
#Copyright(c) 2017, Nathan Chapman
# nchapman@generalheating.com

import clr
clr.AddReference("RevitAPI")
import Autodesk
from Autodesk.Revit.DB import FabricationConfiguration
clr.AddReference("RevitServices")
import RevitServices
from RevitServices.Persistence import DocumentManager

Doc = DocumentManager.Instance.CurrentDBDocument

ItmList = list()

ConfigName = FabricationConfiguration.GetFabricationConfiguration(Doc)
ConfigInfo = ConfigName.GetFabricationConfigurationInfo()
ConfigPath = ConfigInfo.Path
ConfigVersion = ConfigInfo.Version
ConfigUnits = ConfigInfo.UnitSystem
ConfigGUID = ConfigInfo.GUID
ConfigProfile = ConfigName.GetProfile()
ItmList.append(ConfigName)
ItmList.append(ConfigVersion)
ItmList.append(ConfigGUID)
ItmList.append(ConfigUnits)
ItmList.append(ConfigPath)
ItmList.append(ConfigProfile)

OUT = ItmList
# ----------------------------------------
code_block = CodeBlock(seq=fabrication_configuration) { seq[0]; seq[1]; seq[2]; seq[3]; seq[4]; seq[5]; }
name = Element.Name(code_block.out0)
Config_Name = Output(name)
Config_Path = Output(code_block.out4)
eq = code_block.out5 == _  # unwired: arg1
string = StringInput("Global")
if_ = If(test=eq, true=string, false=code_block.out5)
Config_Profile = Output(if_)
Config_Version = Output(code_block.out1)
Config_Units = Output(code_block.out3)
Config_GUID = Output(code_block.out2)
