# Dynamo custom node Part(s) CID Number.dyf (Dynamo 1.3.0.875)
# category: DynaFabrication2018.Parts
# Gets the CID number

Item_s = Input()  # "Item(s)"
count = Count(Item_s)
fabrication_part_cid = Python(IN[0]=Item_s, IN[1]=count)
# ---------- fabrication_part_cid.python (28 lines) ----------
#Copyright(c) 2016, Nathan Chapman
# nchapman@generalheating.com

import clr
clr.AddReference('RevitAPI')
from Autodesk.Revit.DB import *
import clr
clr.AddReference("RevitAPI")
import Autodesk
from Autodesk.Revit.DB import FabricationPart

clr.AddReference("RevitNodes")
import Revit
clr.ImportExtensions(Revit.Elements)

Inpt = UnwrapElement(IN[0])
Cnt = UnwrapElement(IN[1])
ItmList = list()

if Cnt > 1:
	for Item in Inpt:
		CID = Item.ItemCustomId
		ItmList.append(CID)
else:
	CID = Inpt.ItemCustomId
	ItmList.append(CID)

OUT = ItmList
# ----------------------------------------
CID_s = Output(fabrication_part_cid)  # "CID(s)"
id = Element.Id(Item_s)
Part_ID = Output(id)
