# Dynamo custom node Part(s) Rod Length.dyf (Dynamo 1.3.0.875)
# category: DynaFabrication2018.Parts
# Gets Fabrication part rod length(s)

Part_s = Input()  # "Part(s)"
part_s_cid_number = Custom[Part(s) CID Number](Item_s=Part_s)  # Gets the CID number
code_block = CodeBlock { {838,1238,1239,1240,1241,1242,1243,1244,1245,1246,1247,1248,1249,1250}; }
eq = part_s_cid_number.CID_s@L1 == code_block
code_block_2 = CodeBlock { true; }
containsItem = List.ContainsItem(list=eq@L2, item=code_block_2)
filterByBoolMask = List.FilterByBoolMask(list=Part_s, mask=containsItem)
code_block_3 = CodeBlock(item=filterByBoolMask.in) { Flatten({item}); }
part_rod_info = Python(IN[0]=code_block_3)
# ---------- part_rod_info.python (28 lines) ----------
#Copyright(c) 2017, Nathan Chapman
# nchapman@generalheating.com

import clr
clr.AddReference('RevitAPI')
import Autodesk
from Autodesk.Revit.DB import FabricationPart
from Autodesk.Revit.DB import FabricationRodInfo

Inpt = []
ItmList = list()
ItmList1 = list()
ItmList2 = list()

for i in IN[0]:
	Inpt.append(UnwrapElement(i))
	
for e in Inpt:
	STName = e.GetRodInfo().RodCount
	ItmList1.append(STName)
	STName1 = e.GetRodInfo()
	for n in range(STName):
		test = STName1.GetRodLength(n)
		test1 = STName1.GetRodEndPosition(n)
		ItmList.append(test)
		ItmList2.append(test1)

OUT = ItmList, ItmList1, ItmList2
# ----------------------------------------
code_block_4 = CodeBlock(seq=part_rod_info) { seq[0]; seq[1]; seq[2]; }
flatten = Flatten(code_block_4.out0)
chop = List.Chop(list=flatten, lengths=code_block_4.out1)
Rod_Length = Output(chop)
flatten_2 = Flatten(code_block_4.out2)
chop_2 = List.Chop(list=flatten_2, lengths=code_block_4.out1)
Rod_End_Location = Output(chop_2)
