# Dynamo custom node Part(s) ServiceType.dyf (Dynamo 1.3.0.875)
# category: DynaFabrication2018.Parts
# Get Fabrication Part(s) service type

Input = Input()
code_block = CodeBlock(item=Input) { Flatten({item}); }
part_servicetype = Python(IN[0]=code_block)
# ---------- part_servicetype.python (28 lines) ----------
#Copyright(c) 2017, Nathan Chapman
# nchapman@generalheating.com

import clr
clr.AddReference('RevitAPI')
import Autodesk
from Autodesk.Revit.DB import FabricationPart
from Autodesk.Revit.DB import FabricationConfiguration

clr.AddReference("RevitServices")
import RevitServices
from RevitServices.Persistence import DocumentManager

Inpt = []
ItmList = list()
Doc = DocumentManager.Instance.CurrentDBDocument

Config = FabricationConfiguration.GetFabricationConfiguration(Doc)

for i in IN[0]:
	Inpt.append(UnwrapElement(i))
	
for e in Inpt:
	ST = e.ServiceType
	STName = Config.GetServiceTypeName(ST)
	ItmList.append(STName)

OUT = ItmList
# ----------------------------------------
ServiceType = Output(part_servicetype)
