# Dynamo custom node GetRotDiaLux.dyf (Dynamo 2.1.0.7500)
# category: DynaMEP.Geometry.Points
# Get All Rotate from file text DiaLux

listarr = Input(listarr: var[]..[])
python_script = Python(IN[0]=listarr)
# ---------- python_script.python (40 lines) ----------
# Carga las bibliotecas de DesignScript y normas de Python.
import sys
import clr
clr.AddReference('ProtoGeometry')
from Autodesk.DesignScript.Geometry import *

# Las entradas de este nodo se almacenan como lista en las variables IN.
dataEnteringNode = IN

# Incluya el código debajo de esta línea
arr = IN[0]

posArr = list(filter(lambda a: ("Rot" in a), arr))

def splitFn(a):
  return a.split("=")[1]

def joinPoints(p):
  return ','.join(p)

def splitPoints(c):
  return c.split()



coords = list( map(splitFn, posArr) )

pointsArr = []

print(coords)

for s in coords:
  splittedArr = splitPoints(s)
  pointsArr.append(joinPoints(splittedArr))

print(pointsArr)

OUT = pointsArr

# Asigne la salida a la variable OUT.
# ----------------------------------------
transpose = List.Transpose(lists=python_script)
code_block = CodeBlock { ","; }
split = String.Split(str=transpose, separator0=code_block)
stringToNumber = List.String.StringToNumber(str=split)
transpose_2 = List.Transpose(lists=stringToNumber)
code_block_2 = CodeBlock { 2; }
getItemAtIndex = List.GetItemAtIndex(list=transpose_2, index=code_block_2)
double = Output(getItemAtIndex)
