# Dynamo custom node GetShareParameterInfo.dyf (Dynamo 2.1.0.7500)
# category: DynaMEP.RevitModel.Parameter
# Get infomation file share parameter from path

# note: Built GROUP               TYPe
# note: Prameter Name
# note: Pra Group

filepath = Input(filepath: var[]..[])  # File Path txt ShareParameter
# note: Guid
code_block = CodeBlock(t10=filepath)
# ---------- code_block.designscript (34 lines) ----------
t9 = FileSystem.ReadText(t10);
t11 = DSCore.String.Split(t9, ["
"]);
t12 = DSCore.String.Split(t11, ["	"]);
t13 = DSCore.List.Transpose(t12);
x = t13;
t6 = Get.ValueAtIndex(x, 2);
X = t13;
t5 = Get.ValueAtIndex(X, 3);
t14 = DSCore.Object.IsNull(t5);
t15 = DSCore.List.FilterByBoolMask(t6, t14);
t16 = DesignScript.Dictionary.ValueAtKey(t15, "in");
t17 = DesignScript.Dictionary.ValueAtKey(t15, "out");
t18 = DSCore.List.RestOfItems(t17);
t3 = "NAME";
x1 = t13;
t4 = Get.ValueAtIndex(x1, 4);
t19 = DSCore.List.FilterByBoolMask(t4, t14);
t20 = DesignScript.Dictionary.ValueAtKey(t19, "in");
t21 = DesignScript.Dictionary.ValueAtKey(t19, "out");
t22 = DSCore.List.RestOfItems(t21);
t23 = DSCore.String.ToNumber(t22);
n = t23;
t8 = n - 1;
x2 = t13;
t7 = Get.ValueAtIndex(x2, 1);
t24 = DSCore.List.FilterByBoolMask(t7, t14);
t25 = DesignScript.Dictionary.ValueAtKey(t24, "in");
t26 = DesignScript.Dictionary.ValueAtKey(t24, "out");
t27 = DSCore.List.RestOfItems(t26);
t28 = DSCore.List.FilterByBoolMask(t5, t14);
t29 = DesignScript.Dictionary.ValueAtKey(t28, "in");
t30 = DesignScript.Dictionary.ValueAtKey(t28, "out");
t31 = DSCore.List.RestOfItems(t30);
# ----------------------------------------
PrameterName = Output(code_block.t18)
python_script = Python(IN[0]=code_block.t6, IN[1]=code_block.t3)
# ---------- python_script.python (17 lines) ----------
#Copyright(c) 2020, chuongho
# @chuongmep, https://chuongmep.com/
import clr
clr.AddReference('ProtoGeometry')
from Autodesk.DesignScript.Geometry import *

list1=IN[0]
member=IN[1]
cnt=len(list1)
inx=0
indices=[]

while inx<cnt :
	if list1[inx]==member:
		indices.append(inx)
	inx=inx+1
OUT = indices
# ----------------------------------------
code_block_2 = CodeBlock(t2=code_block.t6, t3=python_script, t4=code_block.t8)
# ---------- code_block_2.designscript (4 lines) ----------
A = t2;
START = t3;
t1 = Get.ValueAtIndex(A, (Get.ValueAtIndex(START, 0)) + 1..(Get.ValueAtIndex(START, 1)) - 1);
t5 = DSCore.List.GetItemAtIndex(t1, t4);
# ----------------------------------------
PrameterGroup = Output(code_block_2.t5)
Guid = Output(code_block.t27)
parameterType = Output(code_block.t31)
