# Dynamo custom node SplitByString.dyf (Dynamo 2.5.0.7460)
# category: DynaMEP.List.String
# Split A list By string start and end in list filter

listarr = Input(listarr: var[]..[])
listitem = Input(listitem: var[]..[])
python_script = Python(IN[0]=listarr, IN[1]=listitem)
# ---------- python_script.python (15 lines) ----------
#Copyright(c) 2020, chuongho
# @chuongmep, https://chuongmep.com/
data = IN[0]
item = IN[1]
newlst = []
i=0
for n in item:
	i = i+1
	try:
		lst = data[data.index(n):data.index(item[i])]
		newlst.append(lst)
	except:
		lst = data[data.index(n):-1]
		newlst.append(lst)
OUT = newlst
# ----------------------------------------
listfilter = Output(python_script)
