# Dynamo custom node ToCurve.dyf (Dynamo 2.1.0.7500)
# category: DynaMEP.Geometry.Line
# Convert Line To Curve

Line = Input(Line: var[]..[])
python_script = Python(IN[0]=Line)
# ---------- python_script.python (16 lines) ----------
import clr
clr.AddReference('ProtoGeometry')
import Autodesk.DesignScript.Geometry

a = IN[0]

if isinstance(a, list):
	a = a
else: a = [a]

e = []

for i in a:
	e.append(Autodesk.DesignScript.Geometry.Curve.Offset(i,0))
	
OUT = e
# ----------------------------------------
Curve = Output(python_script)
