# Dynamo custom node Dyno.JsonGenerator.dyf (Dynamo 0.9.0.3067)
# category: Dynablaster

Preset_s = Input()  # "Preset(s)"
python_script = Python(IN[0]=Preset_s)
# ---------- python_script.python (14 lines) ----------
import clr
clr.AddReference('ProtoGeometry')
from Autodesk.DesignScript.Geometry import *
input = IN[0]

cabecera = '{ \n"hideOriginal" : true,\n"presets" : {\n'
cierre = '\n } \n }'

b= ',\n\t'.join(input)

if type(input) == list :
	OUT = cabecera+b+cierre
elif type(input) == str:
	OUT = cabecera+input+cierre
# ----------------------------------------
json_file_content = Output(python_script)
