# Dynamo custom node DynoPresetGenerator.dyf (Dynamo 0.9.0.3067)
# category: Dynablaster
# Generates the Preset for Dyno

Preset_Name = Input()
Preset_Input_s = Input()  # "Preset Input(s)"
python_script = Python(IN[0]=Preset_Name, IN[1]=Preset_Input_s)
# ---------- python_script.python (24 lines) ----------
import clr
clr.AddReference('ProtoGeometry')
from Autodesk.DesignScript.Geometry import *

dataEnteringNode = IN

#give easy names to node inputs:

name = IN[0]
input = IN[1]

#get input type; different behaviour if we get a string or a list of strings

if type(input) == str :
	a='"'+name+'" : {\n\t'+input+'}'
	OUT = a
	
elif type(input) == list :
	b= ',\n\t'.join(input)
	OUT ='"'+name+'" : {\n\t'+b+'\n\t}'
	
#if type is neither a string nor a list of strings,return this error message:
else :
	OUT = 'Non matching input.Please input a single string or a list of strings with corresponding preset inputs'
# ----------------------------------------
Preset_Definition = Output(python_script)
