# Dynamo custom node DynoPresetInputGenerator.dyf (Dynamo 0.9.0.3067)
# category: Dynablaster
# Authomatizes the.dpr file generation

Input_Name = Input()
Input_Value = Input()
Desc = Input()
python_script = Python(IN[0]=Input_Name, IN[1]=Input_Value, IN[2]=Desc)
# ---------- python_script.python (29 lines) ----------
import clr
clr.AddReference('ProtoGeometry')
from Autodesk.DesignScript.Geometry import *
#The inputs to this node will be stored as a list in the IN variables.
dataEnteringNode = IN

InputName=IN[0]
InputValue=IN[1]
Desc=IN[2]

# writes input type to the preset string:

if type(InputName) == str :
	b = 'string'
	
elif type(InputName) == int :
	b = 'number'
	
elif type(InputName) == float :
	b = 'number'
	
elif type(InputName) == bool :
	b= 'bool'
	

PresetInput = '"' + InputName + '" : {"type" : "'+b+'", "value" : "'+InputValue+'", "desc" : "'+Desc+'"}'

#Assign your output to the OUT variable.
OUT = PresetInput
# ----------------------------------------
Input_definition = Output(python_script)
