# Dynamo custom node Enumeration.dyf (Dynamo 0.9.0.3067)
# category: Dynablaster
# Returns a list from 1 to n; where n is the count of the input list. Revamped to prevent unpredictable behaviour when input list was empty. More at: http://dynamonodes.com/

# group: DEPRECATED VERSION. IF LIST WAS EMPTY, IT ALWAYS RETURNED {1,0} BECAUSE IT WAS GOING "REVERSE" FROM 1 TO 0.
code_block = CodeBlock { n=List.Count(list); enum=1..n; }

code_block_2 = CodeBlock { 1; }
list = Input()
count = List.Count(list)
range = Range(start=code_block_2, end=count, step=code_block_2, lacing=Longest)
create = List.Create(range)
removeNulls = Lists.Manage.RemoveNulls(create)
code_block_3 = CodeBlock { 1; }
flatten = List.Flatten(list=removeNulls, amt=code_block_3)
enum = Output(flatten)
