# Dynamo custom node NumberToCharacter AAZZ.dyf (Dynamo 0.8.2.2392)
# category: Dynablaster
# Returns alphabetical equivalent for a given integer.
# from 1 to 26  returns A-Z values. Also provides a list of values from 1 to input integer, translated to alphabet equivalents.
# With higher inputs returns "AA" type values, up to n=676. Higher inputs than this returns "Out of range" string.

Nth = Input(Nth:int=1)
code_block = CodeBlock { 1; }
insert = String.Insert(index=code_block)
code_block_2 = CodeBlock()
# ---------- code_block_2.designscript (17 lines) ----------
def alpha()
{
 a=
  {
  "A","B","C","D","E","F",
  "G","H","I","J","K","L",
  "M","N","O","P","Q","R",
  "S","T","U","V","W","X",
  "Y","Z"
  };

 return=a;

};
a= alpha();
b= List.Count(a);
c= List.OfRepeatedItem(a,b);
# ----------------------------------------
combine = List.Combine(insert, code_block_2.out0, code_block_2.out2)
code_block_3 = CodeBlock(a=combine, index=Nth) { beta = List.Flatten(a,1); beta[index-1]; c=List.Chop(beta,index); lista=c[0]; }
code_block_4 = CodeBlock(index=Nth, beta=code_block_3.beta) { index<=List.Count(alpha()); List.GetItemAtIndex(alpha(),index-1); index>List.Count(beta); }
code_block_5 = CodeBlock { "out of range"; }
if_ = If(test=code_block_4.out2, true=code_block_5, false=code_block_3.out1)
if_2 = If(test=code_block_4.out0, true=code_block_4.out1, false=if_)
Character = Output(if_2)
code_block_6 = CodeBlock(index=Nth) { c=List.Chop(alpha(),index); c[0]; }
if_3 = If(test=code_block_4.out2, true=code_block_5, false=code_block_3.lista)
if_4 = If(test=code_block_4.out0, true=code_block_6.out1, false=if_3)
List_of_characters = Output(if_4)
