# Dynamo custom node TitleblockFromSheet.dyf (Dynamo 0.9.0.3067)
# category: Dynablaster
# Returns the TitleBlock corresponding to the input Sheet element. Also works with lists of Sheets.

categories = Categories("TitleBlocks")
all_elements_of_category = ElementsOfCategory(categories)
code_block = CodeBlock { "Sheet Number"; }
getParameterValueByName = Element.GetParameterValueByName(element=all_elements_of_category, parameterName=code_block)
# note: the expected input is a Sheet or a list of sheets.
sheet_s = Input()  # "sheet(s)"
# note: get the sheet number and performs a search in a dictionary created with the sheet numbers and the titleblocks themselves
sheetNumber = Sheet.SheetNumber(sheet_s)
python_script = Python(IN[0]=getParameterValueByName, IN[1]=all_elements_of_category, IN[2]=sheetNumber)
# ---------- python_script.python (31 lines) ----------
#Coded by Miguel Salvador Altava, March 2016.
#msalvador.altava@gmail.com

import clr
clr.AddReference('ProtoGeometry')
from Autodesk.DesignScript.Geometry import *

dataEnteringNode = IN

keys = IN[0]
values = IN[1]
search = IN[2]
a =list()

# create a dictionary called "mydict" from the keys list and values list
mydict = dict(zip(keys, values))

"""
checks wether the input is a list or a single element. If it's a list,
a loop searches for each input element and the result is appended to the void list created above.
"""
if type(search)==list :

	for s in search :
		b=mydict[s]
		a.append(b)
	
	OUT = a
else :
	b=mydict[search]
	OUT = b
# ----------------------------------------
TitleBlock_s = Output(python_script)  # "TitleBlock(s)"
