# Dynamo custom node paragraphFromStrings.dyf (Dynamo 0.9.0.3067)
# category: Dynablaster
# This node takes a list of strings as input, and returns a single string formatted like a paragraph.

string = StringInput("""import clr
clr.AddReference('ProtoGeometry')
from Autodesk.DesignScript.Geometry import *

OUT = '\n'.join(IN[0])
""")
listOfStrings = Input()
string_from_object = FromObject(listOfStrings)
python_script_from_string = PythonStringNode(script=string, IN[0]=string_from_object)
Paragraph = Output(python_script_from_string)
