# Dynamo custom node Adjust Piers.dyf (Dynamo 1.3.1.1736)
# category: Dynabridge

Piers_Select_Model_Elements = Input()  # "Piers (Select Model Elements)"
Family_Placement_Points = Input()
flatten = Flatten(Family_Placement_Points)
byPoints = NurbsCurve.ByPoints(flatten)
getLocation = Element.GetLocation(Piers_Select_Model_Elements)
closestPointTo = Geometry.ClosestPointTo(geometry=byPoints, other=getLocation)
parameterAtPoint = Curve.ParameterAtPoint(curve=byPoints, point=closestPointTo)
sortByKey = List.SortByKey(list=Piers_Select_Model_Elements, keys=parameterAtPoint)
code_block = CodeBlock { "H"; }
sortByKey_2 = List.SortByKey(list=getLocation, keys=parameterAtPoint)
sortByKey_3 = List.SortByKey()  # unwired: list, keys
Bridge_Body = Input()
byPoints_2 = PolyCurve.ByPoints(points=Family_Placement_Points)
distanceTo = Geometry.DistanceTo(geometry=byPoints_2, other=getLocation, lacing=CrossProduct)
transpose = List.Transpose(distanceTo)
sortByKey_4 = List.SortByKey(list=byPoints_2, keys=transpose@@L2)
firstItem = List.FirstItem(sortByKey_4.sorted_keys@@L2)
allIndicesOf = List.AllIndicesOf(list=transpose@@L2, item=firstItem)
flatten_2 = Flatten(allIndicesOf)
sort = List.Sort(flatten_2)
getItemAtIndex = List.GetItemAtIndex(list=Bridge_Body, index=sort)
faces = Element.Faces(getItemAtIndex)
code_block_2 = CodeBlock { 0.5; }
pointAtParameter = Surface.PointAtParameter(surface=faces, u=code_block_2, v=code_block_2)
Z = Point.Z(pointAtParameter)
combine = List.Combine(sortByKey_3.sorted_list, faces, Z)
firstItem_2 = List.FirstItem(combine@@L2)
ZAxis = Vector.ZAxis()
project = Point.Project(sortByKey_2.sorted_list, firstItem_2, ZAxis)
flatten_3 = Flatten(project)
distanceTo_2 = Geometry.DistanceTo(geometry=flatten_3, other=sortByKey_2.sorted_list)
code_block_3 = CodeBlock(x=distanceTo_2) { x-0.3; }
setParameterByName = Element.SetParameterByName(element=sortByKey.sorted_list, parameterName=code_block, value=code_block_3)
code_block_4 = CodeBlock { "rotation"; }
code_block_5 = CodeBlock { 1; 0.5; }
getIsoline = Surface.GetIsoline(firstItem_2, code_block_5.out0, code_block_5.out1)
code_block_6 = CodeBlock { 0.5; }
pointAtParameter_2 = Curve.PointAtParameter(curve=getIsoline, param=code_block_6)
tangentAtParameter = Curve.TangentAtParameter(getIsoline, code_block_6)
byOriginNormalXAxis = Plane.ByOriginNormalXAxis(origin=pointAtParameter_2, normal=tangentAtParameter, xAxis=ZAxis)
toCoordinateSystem = Plane.ToCoordinateSystem(byOriginNormalXAxis)
ZAxis_2 = CoordinateSystem.ZAxis(toCoordinateSystem)
XAxis = CoordinateSystem.XAxis(toCoordinateSystem)
angleAboutAxis = Vector.AngleAboutAxis(ZAxis_2, tangentAtParameter, XAxis)
setParameterByName_2 = Element.SetParameterByName(element=setParameterByName, parameterName=code_block_4, value=angleAboutAxis)
flatten_4 = Flatten(setParameterByName_2)
Piers = Output(flatten_4)
