# Dynamo custom node Barrier.dyf (Dynamo 1.3.0.875)
# category: Dynabridge

Left_Corridor = Input()
byPoints = PolyCurve.ByPoints(points=Left_Corridor)
curves = PolyCurve.Curves(byPoints)
length = Curve.Length(curves)
code_block = CodeBlock { 0.4; }
lt = length < code_block
filterByBoolMask = List.FilterByBoolMask(list=curves, mask=lt)
startPoint = Curve.StartPoint(filterByBoolMask.out)
endPoint = Curve.EndPoint(filterByBoolMask.out)
create = List.Create(startPoint, endPoint)
transpose = List.Transpose(create)
Barrier_Family = Input()
byPoints_2 = AdaptiveComponent.ByPoints(points=transpose, familyType=Barrier_Family)
setParameterByName = Element.SetParameterByName(element=byPoints_2, lacing=Longest)  # unwired: parameterName, value
code_block_2 = CodeBlock { "Slab Thickness"; "Offset"; "Flip"; }
create_2 = List.Create(code_block_2.out0, code_block_2.out1, code_block_2.out2)
Slab_Thickness = Input(Slab_Thickness : double = 0.25)
Space_Between = Input(Space_Between : double = 0.1)
create_3 = List.Create(Slab_Thickness, Space_Between)
code_block_3 = CodeBlock { false; }
join = List.Join(create_3, code_block_3)
combine = List.Combine(setParameterByName, create_2, join)
lastItem = List.LastItem(combine)
Right_Corridor = Input()
byPoints_3 = PolyCurve.ByPoints(points=Right_Corridor)
curves_2 = PolyCurve.Curves(byPoints_3)
length_2 = Curve.Length(curves_2)
code_block_4 = CodeBlock { 0.4; }
lt_2 = length_2 < code_block_4
filterByBoolMask_2 = List.FilterByBoolMask(list=curves_2, mask=lt_2)
startPoint_2 = Curve.StartPoint(filterByBoolMask_2.out)
endPoint_2 = Curve.EndPoint(filterByBoolMask_2.out)
create_4 = List.Create(startPoint_2, endPoint_2)
transpose_2 = List.Transpose(create_4)
byPoints_4 = AdaptiveComponent.ByPoints(points=transpose_2, familyType=Barrier_Family)
setParameterByName_2 = Element.SetParameterByName(element=byPoints_4, lacing=Longest)  # unwired: parameterName, value
code_block_5 = CodeBlock { true; }
join_2 = List.Join(create_3, code_block_5)
combine_2 = List.Combine(setParameterByName_2, create_2, join_2)
lastItem_2 = List.LastItem(combine_2)
join_3 = List.Join(lastItem, lastItem_2)
Element = Output(join_3)
