# Dynamo custom node Bridge Body.dyf (Dynamo 1.3.2.2480)
# category: Dynabridge

Family_Placement_Points = Input()
Bridge_Familiy = Input()
byPoints = AdaptiveComponent.ByPoints(points=Family_Placement_Points, familyType=Bridge_Familiy)
code_block = CodeBlock { "_"; }
join = String.Join(code_block)  # unwired: arg1, arg2
code_block_2 = CodeBlock { "rot_XY"; }
Coordinate_Systems = Input()
count = Count(Coordinate_Systems@@L2)
firstItem = List.FirstItem(count)
cycle = List.Cycle(list=code_block_2, amount=firstItem)
code_block_3 = CodeBlock { "A"; "B"; "C"; "D"; "E"; }
join_2 = List.Join(code_block_3.out0, code_block_3.out1, code_block_3.out2, code_block_3.out3, code_block_3.out4)
combine = List.Combine(join, cycle, join_2)
takeItems = List.TakeItems(list=combine, amount=firstItem)
YAxis = Vector.YAxis()
YAxis_2 = CoordinateSystem.YAxis(Coordinate_Systems)
ZAxis = Vector.ZAxis()
angleAboutAxis = Vector.AngleAboutAxis(YAxis, YAxis_2, ZAxis)
code_block_4 = CodeBlock { 180; }
gt = angleAboutAxis > code_block_4
code_block_5 = CodeBlock(x=angleAboutAxis) { x-180; }
if_ = If(test=gt, true=code_block_5, false=angleAboutAxis)
count_2 = Count(if_)
ofRepeatedItem = List.OfRepeatedItem(item=takeItems, amount=count_2)
setParameterByName = Element.SetParameterByName(element=byPoints, parameterName=ofRepeatedItem, value=if_, lacing=Longest)
lastItem = List.LastItem(setParameterByName@@L2)
Bridge_Body = Output(lastItem)
