# Dynamo custom node Bridge_equipment_placeholder.dyf (Dynamo 2.10.1.3976)
# category: Dynabridge

Alignment_in_form_of_curve = Input(Alignment_in_form_of_curve: var[]..[])
Offset_from_the_beginning = Input(Offset_from_the_beginning: var[]..[])
length = Curve.Length(curve=Alignment_in_form_of_curve)
Distance_between_the_points = Input(Distance_between_the_points: var[]..[])
code_block = CodeBlock(offset=Offset_from_the_beginning, length=length, step=Distance_between_the_points) { offset..length..step; }
pointAtSegmentLength = Curve.PointAtSegmentLength(curve=Alignment_in_form_of_curve, segmentLength=code_block)
parameterAtPoint = Curve.ParameterAtPoint(curve=Alignment_in_form_of_curve, point=pointAtSegmentLength)
tangentAtParameter = Curve.TangentAtParameter(curve=Alignment_in_form_of_curve, param=parameterAtPoint)
ZAxis = Vector.ZAxis()
byOriginNormalXAxis = Plane.ByOriginNormalXAxis(origin=pointAtSegmentLength, normal=tangentAtParameter, xAxis=ZAxis)
toCoordinateSystem = Plane.ToCoordinateSystem(plane=byOriginNormalXAxis)
flip_position_right_left = Input(flip_position_right_left: bool = false)
Bridge_width = Input(Bridge_width: var[]..[])
code_block_2 = CodeBlock(x=Bridge_width) { x/2; }
code_block_3 = CodeBlock(x=code_block_2) { -x; }
if_ = If(test=flip_position_right_left, true=code_block_3, false=code_block_2)
byCartesianCoordinates = Point.ByCartesianCoordinates(cs=toCoordinateSystem, y=if_)
Corssfall_angle = Input(Corssfall_angle: double = 1)
Offset_from_the_alignment = Input(Offset_from_the_alignment: var[]..[])
code_block_4 = CodeBlock(alpha=Corssfall_angle, L=code_block_2, l=Offset_from_the_alignment) { Math.Tan(alpha)*(L-l); }
Vertical_offset = Input(Vertical_offset: double = 0)
code_block_5 = CodeBlock(a=code_block_4, b=Vertical_offset) { a+b; }
code_block_6 = CodeBlock(x=Offset_from_the_alignment) { -x; }
if_2 = If(test=flip_position_right_left, true=code_block_6, false=Offset_from_the_alignment)
byCartesianCoordinates_2 = Point.ByCartesianCoordinates(cs=toCoordinateSystem, x=code_block_5, y=if_2)
Number_of_points_in_the_family = Input(Number_of_points_in_the_family: var[]..[])
code_block_7 = CodeBlock(x=Number_of_points_in_the_family) { [0..x-1][0]; }
code_block_8 = CodeBlock(x=Number_of_points_in_the_family) { x-1; }
code_block_9 = CodeBlock { 0; }
eq = code_block_8 == code_block_9
code_block_10 = CodeBlock { 1; }
if_3 = If(test=eq, true=code_block_10, false=code_block_8)
sublists = List.Sublists(list=byCartesianCoordinates_2, ranges=code_block_7, offset=if_3)
count = List.Count(list=sublists@L2)
eq_2 = count == Number_of_points_in_the_family
filterByBoolMask = List.FilterByBoolMask(list=sublists, mask=eq_2)
Placement_points_for_the_family = Output(filterByBoolMask.in)
code_block_11 = CodeBlock(alpha=Corssfall_angle, L=code_block_2) { Math.Tan(alpha)*L; }
byCartesianCoordinates_3 = Point.ByCartesianCoordinates(cs=toCoordinateSystem, x=code_block_11)
byTwoPoints = Vector.ByTwoPoints(start=byCartesianCoordinates_3, end=byCartesianCoordinates_2)
Vector_perpendicular_to_the_alignment = Output(byTwoPoints)
