# Dynamo custom node Create 3D line.dyf (Dynamo 1.3.1.1736)
# category: Dynabridge

Alignment_as_points = Input()
code_block = CodeBlock { {0,1}; 1; }
sublists = List.Sublists(list=Alignment_as_points, ranges=code_block.out0, offset=code_block.out1)
count = Count(sublists@@L2)
code_block_2 = CodeBlock { 2; }
eq = count == code_block_2
filterByBoolMask = List.FilterByBoolMask(list=sublists, mask=eq)
family_types = FamilyTypes("3d line:3d line")
byPoints = AdaptiveComponent.ByPoints(points=filterByBoolMask.in, familyType=family_types)
n3D_line = Output(byPoints)  # "3D line"
