# Dynamo custom node Create Corridors.dyf (Dynamo 1.3.0.875)
# category: Dynabridge

Coordinate_Systems = Input()
Left_Corridor_Width_in_meters = Input()  # "Left Corridor (Width in meters)"
code_block = CodeBlock(x=Left_Corridor_Width_in_meters) { -x; }
byCartesianCoordinates = Point.ByCartesianCoordinates(Coordinate_Systems, arg2=code_block)
Left_Corridor = Output(byCartesianCoordinates)
Right_Cooridor_Width_in_meters = Input()  # "Right Cooridor (Width in meters)"
byCartesianCoordinates_2 = Point.ByCartesianCoordinates(Coordinate_Systems, arg2=Right_Cooridor_Width_in_meters)
Right_Corridor = Output(byCartesianCoordinates_2)
