# Dynamo custom node Local Coordinate Systems .dyf "Local Coordinate Systems" (Dynamo 1.3.0.875)
# category: Dynabridge
# Makes local CS's out of Aligment as points

Alignment_as_points = Input()
byPoints = NurbsCurve.ByPoints(Alignment_as_points)
length = Curve.Length(byPoints)
Segment_length = Input()
code_block = CodeBlock(l=length, dist=Segment_length) { 0..l..dist; }
pointAtSegmentLength = Curve.PointAtSegmentLength(curve=byPoints, segmentLength=code_block)
endPoint = Curve.EndPoint(byPoints)
join = List.Join(pointAtSegmentLength, endPoint)
splitByPoints = Curve.SplitByPoints(curve=byPoints, points=join)
Number_of_profiles_in_the_family = Input()
code_block_2 = CodeBlock(n=Number_of_profiles_in_the_family) { 0..1..#n; }
pointAtParameter = Curve.PointAtParameter(curve=splitByPoints, param=code_block_2, lacing=CrossProduct)
parameterAtPoint = Curve.ParameterAtPoint(curve=splitByPoints, point=pointAtParameter)
tangentAtParameter = Curve.TangentAtParameter(splitByPoints, parameterAtPoint)
ZAxis = Vector.ZAxis()
byOriginNormalXAxis = Plane.ByOriginNormalXAxis(origin=pointAtParameter, normal=tangentAtParameter, xAxis=ZAxis)
toCoordinateSystem = Plane.ToCoordinateSystem(byOriginNormalXAxis)
Coordinate_Systems = Output(toCoordinateSystem)
Family_Placement_Points = Output(pointAtParameter)
