# Dynamo custom node Local Coordintate Systems by Grids.dyf (Dynamo 1.3.2.2480)
# category: Dynabridge

Alignment_as_points = Input()
byPoints = NurbsCurve.ByPoints(Alignment_as_points)
Grids_Select_Model_Elements = Input()  # "Grids (Select Model Elements)"
curve = Grid.Curve(Grids_Select_Model_Elements)
code_block = CodeBlock { 0; }
pointAtParameter = Curve.PointAtParameter(curve=curve, param=code_block)
tangentAtParameter = Curve.TangentAtParameter(curve, code_block)
ZAxis = Vector.ZAxis()
byOriginVectors = CoordinateSystem.ByOriginVectors(origin=pointAtParameter, xAxis=tangentAtParameter, yAxis=ZAxis)
XYPlane = CoordinateSystem.XYPlane(byOriginVectors)
intersect = Geometry.Intersect(geometry=byPoints, other=XYPlane)
flatten = Flatten(intersect)
parameterAtPoint = Curve.ParameterAtPoint(curve=byPoints, point=flatten)
sortByKey = List.SortByKey(list=flatten, keys=parameterAtPoint)
splitByPoints = Curve.SplitByPoints(curve=byPoints, points=sortByKey.sorted_list)
length = Curve.Length(splitByPoints)
code_block_2 = CodeBlock { 1; }
lt = length < code_block_2
filterByBoolMask = List.FilterByBoolMask(list=splitByPoints, mask=lt)
Number_of_profiles_in_the_family = Input()
code_block_3 = CodeBlock(n=Number_of_profiles_in_the_family) { 0..1..#n; }
pointAtParameter_2 = Curve.PointAtParameter(curve=filterByBoolMask.out, param=code_block_3, lacing=CrossProduct)
Family_Placement_Points = Output(pointAtParameter_2)
parameterAtPoint_2 = Curve.ParameterAtPoint(curve=filterByBoolMask.out, point=pointAtParameter_2)
tangentAtParameter_2 = Curve.TangentAtParameter(filterByBoolMask.out, parameterAtPoint_2)
ZAxis_2 = Vector.ZAxis()
byOriginNormalXAxis = Plane.ByOriginNormalXAxis(origin=pointAtParameter_2, normal=tangentAtParameter_2, xAxis=ZAxis_2)
toCoordinateSystem = Plane.ToCoordinateSystem(byOriginNormalXAxis)
Coordinate_Systems = Output(toCoordinateSystem)
