# Dynamo custom node Multi pier bridge.dyf (Dynamo 1.3.1.1736)
# category: Dynabridge

Family_Placement_Points = Input()
byPoints = PolyCurve.ByPoints(points=Family_Placement_Points)
Piers_Select_Model_Elements = Input()  # "Piers (Select Model Elements)"
getLocation = Element.GetLocation(Piers_Select_Model_Elements)
distanceTo = Geometry.DistanceTo(geometry=byPoints, other=getLocation, lacing=CrossProduct)
transpose = List.Transpose(distanceTo)
sortByKey = List.SortByKey(list=byPoints, keys=transpose@@L2)
firstItem = List.FirstItem(sortByKey.sorted_keys@@L2)
allIndicesOf = List.AllIndicesOf(list=transpose@@L2, item=firstItem)
flatten = Flatten(allIndicesOf)
sort = List.Sort(flatten)
firstItem_2 = List.FirstItem(sort)
code_block = CodeBlock { 0; }
eq = firstItem_2 == code_block
if_ = If(test=eq)  # unwired: true, false
Maximum_height = Input()
count = Count(Family_Placement_Points@@L2)
firstItem_3 = List.FirstItem(count)
cycle = List.Cycle(list=Maximum_height, amount=firstItem_3)
count_2 = Count(Family_Placement_Points)
code_block_2 = CodeBlock(x=count_2) { x-1; }
lastItem = List.LastItem(sort)
eq_2 = code_block_2 == lastItem
if_2 = If(test=eq_2)  # unwired: true, false
if_3 = If(test=eq_2)  # unwired: true, false
if_4 = If(test=eq)  # unwired: true, false
code_block_3 = CodeBlock { 0; }
code_block_4 = CodeBlock(x=sort) { x+1; }
join = List.Join(code_block_3, code_block_4)
code_block_5 = CodeBlock(x=sort) { x-1; }
join_2 = List.Join(code_block_5, code_block_2)
code_block_6 = CodeBlock(x=join, y=join_2) { x..y; }
restOfItems = List.RestOfItems(code_block_6)
flatten_2 = Flatten(restOfItems)
flatten_3 = Flatten(code_block_6)
combine = List.Combine(if_4, flatten_2, flatten_3)
code_block_7 = CodeBlock { 0; }
clean = List.Clean(list=combine, preserveIndices=code_block_7)
count_3 = Count(restOfItems@@L2)
count_4 = Count(code_block_6@@L2)
combine_2 = List.Combine(if_4, count_3, count_4)
clean_2 = List.Clean(list=combine_2, preserveIndices=code_block_7)
chop = List.Chop(list=clean, lengths=clean_2)
reverse = List.Reverse(chop)
restOfItems_2 = List.RestOfItems(reverse)
reverse_2 = List.Reverse(restOfItems_2)
flatten_4 = Flatten(reverse_2)
flatten_5 = Flatten(chop)
combine_3 = List.Combine(if_3, flatten_4, flatten_5)
code_block_8 = CodeBlock { 0; }
clean_3 = List.Clean(list=combine_3, preserveIndices=code_block_8)
count_5 = Count(reverse_2@@L2)
count_6 = Count(chop@@L2)
combine_4 = List.Combine(if_3, count_5, count_6)
clean_4 = List.Clean(list=combine_4, preserveIndices=code_block_8)
chop_2 = List.Chop(list=clean_3, lengths=clean_4)
getItemAtIndex = List.GetItemAtIndex(list=Family_Placement_Points, index=chop_2)
flatten_6 = Flatten(getItemAtIndex@@L3)
code_block_9 = CodeBlock { 2; }
byPoints_2 = NurbsCurve.ByPoints(flatten_6, code_block_9)
parameterAtPoint = Curve.ParameterAtPoint(curve=byPoints_2, point=flatten_6, lacing=Longest)
segmentLengthAtParameter = Curve.SegmentLengthAtParameter(byPoints_2, parameterAtPoint)
code_block_10 = CodeBlock { 0; 180; }
remapRange = Math.RemapRange(numbers=segmentLengthAtParameter, newMin=code_block_10.out0, newMax=code_block_10.out1)
sin = Math.Sin(remapRange)
Curvature_factor = Input()
code_block_11 = CodeBlock(x=Curvature_factor) { -x; }
mul = sin * code_block_11
add = mul + Maximum_height  # lacing=Longest
chop_3 = List.Chop(list=add@L2, lengths=firstItem_3)
addItemToEnd = List.AddItemToEnd(item=cycle, list=chop_3@@L3)
code_block_12 = CodeBlock { 1; }
flatten_7 = List.Flatten(list=addItemToEnd, amt=code_block_12)
flatten_8 = Flatten(flatten_7)
count_7 = Count(flatten_7)
code_block_13 = CodeBlock(x=count_7) { x-1; }
removeItemAtIndex = List.RemoveItemAtIndex(list=flatten_7, indices=code_block_13)
flatten_9 = Flatten(removeItemAtIndex)
combine_5 = List.Combine(if_2, flatten_8, flatten_9)
code_block_14 = CodeBlock { 0; }
clean_5 = List.Clean(list=combine_5, preserveIndices=code_block_14)
addItemToFront = List.AddItemToFront(item=cycle, list=clean_5)
flatten_10 = Flatten(addItemToFront)
combine_6 = List.Combine(if_, flatten_10, combine_5)
clean_6 = List.Clean(list=combine_6, preserveIndices=code_block_14)
chop_4 = List.Chop(list=clean_6, lengths=firstItem_3)
Height = Output(chop_4)
