# Dynamo custom node Place Street Lamps.dyf (Dynamo 1.3.1.1736)
# category: Dynabridge

Street_lamp_family = Input()
Family_Placement_Points = Input()
flatten = Flatten(Family_Placement_Points)
pruneDuplicates = Point.PruneDuplicates(points=flatten)
byPoints = NurbsCurve.ByPoints(pruneDuplicates)
length = Curve.Length(byPoints)
Distance_between_lamps = Input()
code_block = CodeBlock(n=length, dist=Distance_between_lamps) { 0..n..dist; }
pointAtSegmentLength = Curve.PointAtSegmentLength(curve=byPoints, segmentLength=code_block)
Corridor_Left_or_Right = Input()  # "Corridor (Left or Right)"
flatten_2 = Flatten(Corridor_Left_or_Right)
pruneDuplicates_2 = Point.PruneDuplicates(points=flatten_2)
byPoints_2 = NurbsCurve.ByPoints(pruneDuplicates_2)
parameterAtPoint = Curve.ParameterAtPoint(curve=byPoints, point=pointAtSegmentLength)
tangentAtParameter = Curve.TangentAtParameter(byPoints_2, parameterAtPoint)
ZAxis = Vector.ZAxis()
byOriginNormalXAxis = Plane.ByOriginNormalXAxis(origin=pointAtSegmentLength, normal=tangentAtParameter, xAxis=ZAxis)
toCoordinateSystem = Plane.ToCoordinateSystem(byOriginNormalXAxis)
Crossfall = Input()
closestPointTo = Geometry.ClosestPointTo(geometry=byPoints_2, other=pointAtSegmentLength)
distanceTo = Geometry.DistanceTo(geometry=pointAtSegmentLength, other=closestPointTo)
code_block_2 = CodeBlock(alfa=Crossfall, y=distanceTo) { Math.Tan(alfa) * y; }
byCartesianCoordinates = Point.ByCartesianCoordinates(toCoordinateSystem, code_block_2)
byTwoPoints = Vector.ByTwoPoints(start=byCartesianCoordinates, end=closestPointTo)
Distance_from_the_center = Input()
translate = Geometry.Translate(geometry=byCartesianCoordinates, direction=byTwoPoints, distance=Distance_from_the_center)
byPoint = FamilyInstance.ByPoint(familyType=Street_lamp_family, point=translate)
YAxis = CoordinateSystem.YAxis(toCoordinateSystem)
YAxis_2 = Vector.YAxis()
ZAxis_2 = Vector.ZAxis()
angleAboutAxis = Vector.AngleAboutAxis(YAxis, YAxis_2, ZAxis_2)
Rotation = Input()
code_block_3 = CodeBlock(x=angleAboutAxis, ang=Rotation) { x+ang; }
setRotation = FamilyInstance.SetRotation(familyInstance=byPoint, degree=code_block_3)
code_block_4 = CodeBlock(FamilyInstance=setRotation) { FamilyInstance; }
