# Dynamo custom node Read Alignment From Excel.dyf (Dynamo 1.3.1.1736)
# category: Dynabridge
# Reads the coordinates from the excel sheet. Sheet name is needed

categories = Categories("ProjectBasePoint")
all_elements_of_category = ElementsOfCategory(categories)
parameters = Element.Parameters(all_elements_of_category)
name = Parameter.Name(parameters)
flatten = Flatten(name)
sort = List.Sort(flatten)
code_block = CodeBlock { {7,4,5}; }
getItemAtIndex = List.GetItemAtIndex(list=sort, index=code_block)
Excel_file_path = Input()
fromPath = FileObject(Excel_file_path)  # "File.FromPath"
Sheet_name = Input()
readFromFile = Excel.ReadFromFile(file=fromPath, sheetName=Sheet_name)
code_block_2 = CodeBlock { 0; 1; 2; }
getItemAtIndex_2 = List.GetItemAtIndex(list=readFromFile@L2, index=code_block_2.out0)
firstItem = List.FirstItem(getItemAtIndex_2)
getItemAtIndex_3 = List.GetItemAtIndex(list=readFromFile@L2, index=code_block_2.out1)
firstItem_2 = List.FirstItem(getItemAtIndex_3)
getItemAtIndex_4 = List.GetItemAtIndex(list=readFromFile@L2, index=code_block_2.out2)
firstItem_3 = List.FirstItem(getItemAtIndex_4)
create = List.Create(firstItem, firstItem_2, firstItem_3)
setParameterByName = Element.SetParameterByName(element=all_elements_of_category, parameterName=getItemAtIndex, value=create, lacing=Longest)
sub = getItemAtIndex_3 - firstItem_2
sub_2 = getItemAtIndex_2 - firstItem
sub_3 = getItemAtIndex_4 - firstItem_3
byCoordinates = Point.ByCoordinates(x=sub, y=sub_2, z=sub_3)
Alignment_as_points = Output(byCoordinates)
