# Dynamo custom node Safety Barrier Posts.dyf (Dynamo 1.3.1.1736)
# category: Dynabridge
# Adaptive Component, 2 points based, perpendicular to the alignment

Family_Placement_Points = Input()
flatten = Flatten(Family_Placement_Points)
pruneDuplicates = Point.PruneDuplicates(points=flatten)
byPoints = NurbsCurve.ByPoints(pruneDuplicates)
Corridor_Left_or_Right = Input()  # "Corridor (Left or Right)"
flatten_2 = Flatten(Corridor_Left_or_Right)
pruneDuplicates_2 = Point.PruneDuplicates(points=flatten_2)
byPoints_2 = NurbsCurve.ByPoints(pruneDuplicates_2)
length = Curve.Length(byPoints_2)
Distance_between_posts = Input()
code_block = CodeBlock(n=length, dist=Distance_between_posts) { 0..n..dist; }
join = List.Join(code_block, length)
pointAtSegmentLength = Curve.PointAtSegmentLength(curve=byPoints_2, segmentLength=join)
closestPointTo = Geometry.ClosestPointTo(geometry=byPoints, other=pointAtSegmentLength)
parameterAtPoint = Curve.ParameterAtPoint(curve=byPoints, point=closestPointTo)
tangentAtParameter = Curve.TangentAtParameter(byPoints, parameterAtPoint)
ZAxis = Vector.ZAxis()
byOriginNormalXAxis = Plane.ByOriginNormalXAxis(origin=closestPointTo, normal=tangentAtParameter, xAxis=ZAxis)
toCoordinateSystem = Plane.ToCoordinateSystem(byOriginNormalXAxis)
Crossfall = Input()
distanceTo = Geometry.DistanceTo(geometry=pointAtSegmentLength, other=closestPointTo)
code_block_2 = CodeBlock(alfa=Crossfall, y=distanceTo) { Math.Tan(alfa) * y; }
byCartesianCoordinates = Point.ByCartesianCoordinates(toCoordinateSystem, code_block_2)
byTwoPoints = Vector.ByTwoPoints(start=byCartesianCoordinates, end=pointAtSegmentLength)
Distance_from_the_center = Input()
translate = Geometry.Translate(geometry=byCartesianCoordinates, direction=byTwoPoints, distance=Distance_from_the_center)
Post_height = Input()
translate_2 = Geometry.Translate(geometry=translate, zTranslation=Post_height)
create = List.Create(translate, translate_2)
transpose = List.Transpose(create)
Safety_barrier_post_family = Input()
byPoints_3 = AdaptiveComponent.ByPoints(points=transpose, familyType=Safety_barrier_post_family)
code_block_3 = CodeBlock { "rotation"; }
YAxis = Vector.YAxis()
byPoints_4 = NurbsCurve.ByPoints(translate)
parameterAtPoint_2 = Curve.ParameterAtPoint(curve=byPoints_4, point=translate)
tangentAtParameter_2 = Curve.TangentAtParameter(byPoints_4, parameterAtPoint_2)
ZAxis_2 = Vector.ZAxis()
byOriginNormalXAxis_2 = Plane.ByOriginNormalXAxis(origin=translate, normal=tangentAtParameter_2, xAxis=ZAxis_2)
toCoordinateSystem_2 = Plane.ToCoordinateSystem(byOriginNormalXAxis_2)
YAxis_2 = CoordinateSystem.YAxis(toCoordinateSystem_2)
angleAboutAxis = Vector.AngleAboutAxis(YAxis, YAxis_2, ZAxis_2)
Rotation = Input()
code_block_4 = CodeBlock(x=angleAboutAxis, y=Rotation) { x+y; }
setParameterByName = Element.SetParameterByName(element=byPoints_3, parameterName=code_block_3, value=code_block_4)
Safety_Barrier_Posts = Output(setParameterByName)
