# Dynamo custom node Safety Barrier.dyf (Dynamo 1.3.1.1736)
# category: Dynabridge
# Adatpive component, parallel to the alignment, 2 points based

Family_Placement_Points = Input()
flatten = Flatten(Family_Placement_Points)
pruneDuplicates = Point.PruneDuplicates(points=flatten)
byPoints = NurbsCurve.ByPoints(pruneDuplicates)
Corridor_Left_or_Right = Input()  # "Corridor (Left or Right)"
flatten_2 = Flatten(Corridor_Left_or_Right)
pruneDuplicates_2 = Point.PruneDuplicates(points=flatten_2)
byPoints_2 = NurbsCurve.ByPoints(pruneDuplicates_2)
length = Curve.Length(byPoints_2)
Distance_between_placement_points = Input()
code_block = CodeBlock(n=length, dist=Distance_between_placement_points) { 0..n..dist; }
join = List.Join(code_block, length)
pointAtSegmentLength = Curve.PointAtSegmentLength(curve=byPoints_2, segmentLength=join)
closestPointTo = Geometry.ClosestPointTo(geometry=byPoints, other=pointAtSegmentLength)
parameterAtPoint = Curve.ParameterAtPoint(curve=byPoints, point=closestPointTo)
tangentAtParameter = Curve.TangentAtParameter(byPoints, parameterAtPoint)
ZAxis = Vector.ZAxis()
byOriginNormalXAxis = Plane.ByOriginNormalXAxis(origin=closestPointTo, normal=tangentAtParameter, xAxis=ZAxis)
toCoordinateSystem = Plane.ToCoordinateSystem(byOriginNormalXAxis)
Crossfall = Input()
distanceTo = Geometry.DistanceTo(geometry=pointAtSegmentLength, other=closestPointTo)
code_block_2 = CodeBlock(alfa=Crossfall, y=distanceTo) { Math.Tan(alfa) * y; }
byCartesianCoordinates = Point.ByCartesianCoordinates(toCoordinateSystem, code_block_2)
byTwoPoints = Vector.ByTwoPoints(start=byCartesianCoordinates, end=pointAtSegmentLength)
Distance_from_center = Input()
translate = Geometry.Translate(geometry=byCartesianCoordinates, direction=byTwoPoints, distance=Distance_from_center)
Barrier_height = Input()
translate_2 = Geometry.Translate(geometry=translate, zTranslation=Barrier_height)
code_block_3 = CodeBlock { {0,1}; 1; }
sublists = List.Sublists(list=translate_2, ranges=code_block_3.out0, offset=code_block_3.out1)
count = Count(sublists@@L2)
code_block_4 = CodeBlock { 2; }
eq = count == code_block_4
filterByBoolMask = List.FilterByBoolMask(list=sublists, mask=eq)
Safety_Barrier_Family = Input()
byPoints_3 = AdaptiveComponent.ByPoints(points=filterByBoolMask.in, familyType=Safety_Barrier_Family)
code_block_5 = CodeBlock { "Flip"; }
Flip_true_false = Input()  # "Flip? (true/false)"
setParameterByName = Element.SetParameterByName(element=byPoints_3, parameterName=code_block_5, value=Flip_true_false)
Safety_Barrier = Output(setParameterByName)
