# Dynamo custom node Set Bridge's Parameter.dyf (Dynamo 1.3.1.1736)
# category: Dynabridge

Bridge_Body = Input()
code_block = CodeBlock { "_"; }
join = String.Join(code_block)  # unwired: arg1, arg2
Parameter_Name = Input()
Family_Placement_Points = Input()
count = Count(Family_Placement_Points@@L2)
firstItem = List.FirstItem(count)
cycle = List.Cycle(list=Parameter_Name, amount=firstItem)
code_block_2 = CodeBlock { "A"; "B"; "C"; "D"; "E"; }
join_2 = List.Join(code_block_2.out0, code_block_2.out1, code_block_2.out2, code_block_2.out3, code_block_2.out4)
combine = List.Combine(join, cycle, join_2)
takeItems = List.TakeItems(list=combine, amount=firstItem)
count_2 = Count(Family_Placement_Points)
ofRepeatedItem = List.OfRepeatedItem(item=takeItems, amount=count_2)
Parameter_Value = Input()
setParameterByName = Element.SetParameterByName(element=Bridge_Body, parameterName=ofRepeatedItem, value=Parameter_Value)
firstItem_2 = List.FirstItem(setParameterByName@@L2)
item = Output(firstItem_2)
