# Dynamo custom node Cable Tray Element Collector.dyf (Dynamo 1.0.0.1180)
# category: Dynamo4MEP.Collectors
# Cable Tray Element Collector

Run = Input()
python_script = Python(IN[0]=Run)
# ---------- python_script.python (121 lines) ----------
#Copyright(c) 2016, Cesare Caoduro
# http://bimandothers.blogspot.com

import clr

# Import RevitAPI
clr.AddReference("RevitAPI")
import Autodesk
from Autodesk.Revit.DB import *

# Import DocumentManager and TransactionManager
clr.AddReference("RevitServices")
import RevitServices
from RevitServices.Persistence import DocumentManager
from RevitServices.Transactions import TransactionManager

# Import ToDSType(bool) extension method
clr.AddReference("RevitNodes")
import Revit
clr.ImportExtensions(Revit.Elements)
clr.ImportExtensions(Revit.GeometryConversion)

import clr
clr.AddReference('ProtoGeometry')
from Autodesk.DesignScript.Geometry import *


def FeetToMm(d):
	return d * 304.8
	
def MmToFeet(d):
	return d / 304.8
	
def MtoFeet(d):
	return d / 0.3048
	
#The input to this node will be stored in the IN[0] variable.

doc =  DocumentManager.Instance.CurrentDBDocument
app =  DocumentManager.Instance.CurrentUIApplication.Application


output = []

collector = FilteredElementCollector(doc)
collector.OfCategory(BuiltInCategory.OST_CableTray)

famtypeitr = collector.GetElementIdIterator()
famtypeitr.Reset()
tr = doc.ActiveProjectLocation.GetTotalTransform()

level = []
size = []
length = []
elevation = []
description = []
curves = []
items = []

runme = IN[0]
if runme:
	levels = []
	elementids = []
	sizes = []
	lengths = []
	elevations = []
	descriptions = []
	connectors = []
	for item in famtypeitr:
		elmID = item
		eleminst = doc.GetElement(elmID)
		
		for p in eleminst.Parameters:
			if p.Definition.Name == 'Reference Level':
				level = p.AsValueString()
			if p.Definition.Name == 'Description':
				description = p.AsString()
			if p.Definition.Name == 'Size':
				size = p.AsString()
			if p.Definition.Name == 'Length':
				length = p.AsDouble()
			if p.Definition.Name == 'Bottom Elevation':
				elevation = p.AsDouble()
	
		elementid = eleminst.Id.ToString()
	
		if level:
			elementids.append(elementid)
			levels.append(level)
			sizes.append(size)
			lengths.append(length)
			elevations.append(elevation)
			descriptions.append(description)
			loc = eleminst.Location
			curves.append(loc.Curve.ToProtoType())
			points = []
			for connector in eleminst.ConnectorManager.Connectors:
				o = connector.Origin
				# se vuoi usare le coordinate globali
				o = tr.Inverse.OfPoint(o)
				x = FeetToMm(o.X)
				y = FeetToMm(o.Y)
				z = FeetToMm(o.Z)
				point = Point.ByCoordinates(x, y, z)
				points.append(point)
			connectors.append(points)
			items.append(eleminst)
	
	output.append(items)
	output.append(elementids)
	output.append(levels)
	output.append(elevations)
	output.append(sizes)
	output.append(lengths)
	output.append(descriptions)
	output.append(curves)
	output.append(connectors)
	
        
#Assign your output to the OUT variable
OUT = output
# ----------------------------------------
number = DoubleInput(4)
getItemAtIndex = List.GetItemAtIndex(list=python_script, index=number)
Size = Output(getItemAtIndex)
number_2 = DoubleInput(1)
getItemAtIndex_2 = List.GetItemAtIndex(list=python_script, index=number_2)
Element_ID = Output(getItemAtIndex_2)
number_3 = DoubleInput(2)
getItemAtIndex_3 = List.GetItemAtIndex(list=python_script, index=number_3)
Level_Name = Output(getItemAtIndex_3)
number_4 = DoubleInput(5)
getItemAtIndex_4 = List.GetItemAtIndex(list=python_script, index=number_4)
Length = Output(getItemAtIndex_4)
number_5 = DoubleInput(3)
getItemAtIndex_5 = List.GetItemAtIndex(list=python_script, index=number_5)
Elevation = Output(getItemAtIndex_5)
number_6 = DoubleInput(6)
getItemAtIndex_6 = List.GetItemAtIndex(list=python_script, index=number_6)
Description = Output(getItemAtIndex_6)
number_7 = DoubleInput(0)
getItemAtIndex_7 = List.GetItemAtIndex(list=python_script, index=number_7)
Elements = Output(getItemAtIndex_7)
number_8 = DoubleInput(7)
getItemAtIndex_8 = List.GetItemAtIndex(list=python_script, index=number_8)
Curves = Output(getItemAtIndex_8)
number_9 = DoubleInput(8)
getItemAtIndex_9 = List.GetItemAtIndex(list=python_script, index=number_9)
Connectors = Output(getItemAtIndex_9)
