# Dynamo custom node Element Collector from Linked File(s).dyf (Dynamo 1.0.0.1180)
# category: Dynamo4MEP.Collectors
# Element Collector from Linked File(s)

Link_s = Input()  # "Link(s)"
Category = Input()
python_script = Python(IN[0]=Link_s, IN[1]=Category)
# ---------- python_script.python (28 lines) ----------
#Copyright(c) 2016 http://bimandothers.blogspot.com
#Please contact at cesare.caoduro@gmail.com

import clr
clr.AddReference('RevitAPI')
clr.AddReference("RevitNodes")

import Revit
import Autodesk
from Autodesk.Revit.DB import *

clr.AddReference("RevitServices")
import RevitServices
from RevitServices.Persistence import DocumentManager
from RevitServices.Transactions import TransactionManager
doc = DocumentManager.Instance.CurrentDBDocument

link = UnwrapElement(IN[0])
category = UnwrapElement(IN[1])
el = []

for l in link:
	fil = ElementCategoryFilter(category.Id)
	coll = FilteredElementCollector(l).WherePasses(fil).WhereElementIsNotElementType().ToElements()
	el.append(coll)
	
	
OUT = el
# ----------------------------------------
Element_s = Output(python_script)  # "Element(s)"
