# Dynamo custom node Element Cut with Void.dyf (Dynamo 1.0.0.1180)
# category: Dynamo4MEP.Elements
# Cut a list of elements with void instances

Element_s = Input()  # "Element(s)"
Void_s = Input()  # "Void(s)"
Cut = Input()
python_script = Python(IN[0]=Element_s, IN[1]=Void_s, IN[2]=Cut)
# ---------- python_script.python (31 lines) ----------
import clr
clr.AddReference('RevitAPI')
from Autodesk.Revit.DB import *
clr.AddReference("RevitServices")
clr.AddReference("ProtoGeometry")
from Autodesk.DesignScript.Geometry import *
import RevitServices
from RevitServices.Persistence import DocumentManager
from RevitServices.Transactions import TransactionManager

doc = DocumentManager.Instance.CurrentDBDocument

eletocut = UnwrapElement(IN[0])
voids = UnwrapElement(IN[1])
cut = IN[2]

output = []
if cut:
	for i in eletocut:			
		for j in voids:
			try:
				TransactionManager.Instance.EnsureInTransaction(doc)
				InstanceVoidCutUtils.AddInstanceVoidCut(doc, i, j)
				TransactionManager.Instance.TransactionTaskDone()
				output.append("Cut")
			except:
				output.append("Oops")
				pass
		

OUT =  output
# ----------------------------------------
OUT = Output(python_script)
