# Dynamo custom node Geometry Insersection by Level.dyf (Dynamo 1.0.0.1180)
# category: Dynamo4MEP.Geometry
# Get intersection between geometries by level

Base_Geometry = Input()
Intersection_Geometry = Input()
Level_s = Input()  # "Level(s)"
python_script = Python(IN[0]=Base_Geometry, IN[1]=Intersection_Geometry, IN[2]=Level_s)
# ---------- python_script.python (40 lines) ----------
#Copyright(c) 2016 http://bimandothers.blogspot.com
#Please contact at cesare.caoduro@gmail.com

import clr
clr.AddReference('RevitAPI')
clr.AddReference("RevitNodes")

import Revit
import Autodesk
from Autodesk.Revit.DB import *

clr.AddReference("RevitServices")
import RevitServices
from RevitServices.Persistence import DocumentManager
from RevitServices.Transactions import TransactionManager
doc = DocumentManager.Instance.CurrentDBDocument

baseGeometry = IN[0]
intersectionGeometry = IN[1]
lev = IN[2]
interferences = []
levels = []
output = []


for i in intersectionGeometry:
	k = 0
	for j in baseGeometry:
		interference = i.DoesIntersect(j)
		if interference == True:
			interferences.append(j.Intersect(i))
			levels.append(lev[k])
		k += 1
			

output.append(interferences)
output.append(levels)
			
OUT = output
			
# ----------------------------------------
code_block = CodeBlock(lst=python_script) { lst[0]; lst[1]; }
flatten = Flatten(code_block.out0)
Element_s = Output(flatten)  # "Element(s)"
flatten_2 = Flatten(code_block.out1)
Level_s_2 = Output(flatten_2)  # "Level(s)"
