# Dynamo custom node Geometry Intersection.dyf (Dynamo 1.0.0.1180)
# category: Dynamo4MEP.Geometry
# Find the intersection solid between two list of geometries

Base_Geometry = Input()
Intersection_Geometry = Input()
python_script = Python(IN[0]=Base_Geometry, IN[1]=Intersection_Geometry)
# ---------- python_script.python (32 lines) ----------
#Copyright(c) 2016 http://bimandothers.blogspot.com
#Please contact at cesare.caoduro@gmail.com

import clr
clr.AddReference('RevitAPI')
clr.AddReference("RevitNodes")

import Revit
import Autodesk
from Autodesk.Revit.DB import *

clr.AddReference("RevitServices")
import RevitServices
from RevitServices.Persistence import DocumentManager
from RevitServices.Transactions import TransactionManager
doc = DocumentManager.Instance.CurrentDBDocument

baseGeometry = IN[0]
intersectionGeometry = IN[1]
interferences = []


for i in intersectionGeometry:
	for j in baseGeometry:
		interference = i.DoesIntersect(j)
		if interference == True:
			interferences.append(j.Intersect(i))

			
			
OUT = interferences
			
# ----------------------------------------
flatten = Flatten(python_script)
Element_s = Output(flatten)  # "Element(s)"
