# Dynamo custom node Image From Directory.dyf (Dynamo 1.0.0.1180)
# category: Dynamo4MEP.Elements
# Create drafting views from images in specific directory

python_script = Python()
# ---------- python_script.python (21 lines) ----------
#Copyright(c) 2016, Cesare Caoduro
# http://bimandothers.blogspot.com

import clr
clr.AddReference('ProtoGeometry')
from Autodesk.DesignScript.Geometry import *

# Import DocumentManager and TransactionManager
clr.AddReference("RevitServices")
import RevitServices
from RevitServices.Persistence import DocumentManager
from RevitServices.Transactions import TransactionManager

#Import RevitAPI
clr.AddReference("RevitAPI")
import Autodesk
from Autodesk.Revit.DB import *
import System

#Assign your output to the OUT variable
OUT = System.Enum.GetValues(BoxPlacement)
# ----------------------------------------
watch = Watch(python_script)
code_block = CodeBlock(IN=python_script) { IN[0]; }
code_block_2 = CodeBlock { Autodesk.Point.ByCoordinates(0,0,0); 72; }
python_script_2 = Python(IN[0]=code_block, IN[1]=code_block_2.out0, IN[2]=code_block_2.out1)
# ---------- python_script_2.python (41 lines) ----------
#Copyright(c) 2016, Cesare Caoduro
# http://bimandothers.blogspot.com

import clr
clr.AddReference('ProtoGeometry')
from Autodesk.DesignScript.Geometry import *

# Import Revit API
clr.AddReference("RevitAPI")
import Autodesk
from Autodesk.Revit.DB import *

# The inputs to this node will be stored as a list in the IN variable.
dataEnteringNode = IN

placement = IN[0]
refPt = IN[1]
res = IN[2]

iio = ImageImportOptions()

def toRvtPoint(point):
	x = point.X
	y = point.Y
	z = point.Z
	return XYZ(x,y,z,)
	
message = None
if placement != None:
	iio.Placement = placement
if refPt != None:
	iio.RefPoint = toRvtPoint(refPt)
else:
	message = "Please specify placement point."
if res != None:
	iio.Resolution - res
else:
	iio.Resolution - 72
	
# Assign your output to the OUT variable
OUT = iio
# ----------------------------------------
watch_2 = Watch(python_script_2)
Directory_Path = Input()
fromPath = DirectoryObject(Directory_Path)  # "Directory.FromPath"
string = StringInput("*")
contents = Directory.Contents(fromPath, string)
watch_3 = Watch(contents)
boolean = BoolSelector(false)
fileName = FilePath.FileName(watch_3, boolean)
byName = DraftingView.ByName(fileName)
watch_4 = Watch(byName)
duct_element_collector = Custom[Duct Element Collector]()  # Duct Element Collector
boolean_2 = BoolSelector(true)
python_script_3 = Python(IN[0]=watch_3, IN[1]=python_script_2, IN[2]=byName, IN[3]=boolean_2)
# ---------- python_script_3.python (57 lines) ----------
#Copyright(c) 2016, Cesare Caoduro
# http://bimandothers.blogspot.com

import clr
clr.AddReference('ProtoGeometry')
from Autodesk.DesignScript.Geometry import *

# Import Element wrapper extension methods
clr.AddReference("RevitNodes")
import Revit
clr.ImportExtensions(Revit.Elements)

#Import geometry conversion extension methods
clr.ImportExtensions(Revit.GeometryConversion)

# Import DocumentManager and TransactionManager
clr.AddReference("RevitServices")
import RevitServices
from RevitServices.Persistence import DocumentManager
from RevitServices.Transactions import TransactionManager

doc = DocumentManager.Instance.CurrentDBDocument
uiapp = DocumentManager.Instance.CurrentUIApplication
app = uiapp.Application

# Import RevitAPI
clr.AddReference("RevitAPI")
import Autodesk
from Autodesk.Revit.DB import *

# The inputs to this node will be stored as a list in the IN variable.
dataEnteringNode = IN

filePath= IN[0]
iio = IN[1]
view = UnwrapElement(IN[2])
RunIt = IN[3]

images = []
if RunIt:
	# Start Transaction
	TransactionManager.Instance.EnsureInTransaction(doc)
	for path1, view1 in zip(filePath, view):
		newElement = clr.StrongBox[Element]()
		doc.Import(path1, iio, view1, newElement)
		images.append(newElement.Value)	
	# End Transaction
	TransactionManager.Instance.TransactionTaskDone()
	message = "Success!"
else:
	message = "Set RunIt to True."
	
# Assign your output to the OUT variable
if message == "Success!":
	OUT = images
else:
	OUT = message
# ----------------------------------------
Elements = Output(python_script_3)
