# Dynamo custom node Mechanical Equipment Element Collector.dyf (Dynamo 1.0.0.1180)
# category: Dynamo4MEP.Collectors
# Mechanical Equipment Element Collector

connectors = Python()
# ---------- connectors.python (79 lines) ----------
#Autodesk Consulting AEC EMEA
import clr
clr.AddReference('ProtoGeometry')
from Autodesk.DesignScript.Geometry import *
# Import ToDSType(bool) extension method
clr.AddReference("RevitNodes")
import Revit
clr.ImportExtensions(Revit.Elements)
# Import geometry conversion extension methods
clr.ImportExtensions(Revit.GeometryConversion)
# Import DocumentManager and TransactionManager
clr.AddReference("RevitServices")
import RevitServices
from RevitServices.Persistence import DocumentManager
from RevitServices.Transactions import TransactionManager
from System.Collections.Generic import *
# Import RevitAPI
clr.AddReference("RevitAPI")
import Autodesk
from Autodesk.Revit.DB import *

def MakeList(a):
	if hasattr(a,"__iter__"):
		return a
	else:
		return [a]

def FeetToMm(d):
	return d * 304.8
	
def MmToFeet(d):
	return d / 304.8
	
def MtoFeet(d):
	return d / 0.3048

doc = DocumentManager.Instance.CurrentDBDocument
uiapp = DocumentManager.Instance.CurrentUIApplication
app = uiapp.Application
uidoc=DocumentManager.Instance.CurrentUIApplication.ActiveUIDocument

input = MakeList(UnwrapElement(IN[0]))

output = []

# se vuoi usare le coordinate globali
tr = doc.ActiveProjectLocation.GetTotalTransform()

for element in input:
	if ("Duct" in str(element)) or ("Pipe" in str(element)) or ("Wire" in str(element)) or ("InsulationLiningBase" in str(element)) or ("Cable" in str(element)) :
		for connector in element.ConnectorManager.Connectors:
			o = connector.Origin
			# se vuoi usare le coordinate globali
			o = tr.Inverse.OfPoint(o)
			x = FeetToMm(o.X)
			y = FeetToMm(o.Y)
			z = FeetToMm(o.Z)
			output.append([element.Id.IntegerValue,connector.Id,x,y,z])
	else:
		for connector in element.MEPModel.ConnectorManager.Connectors:
			o = connector.Origin
			# se vuoi usare le coordinate globali
			o = tr.Inverse.OfPoint(o)
			x = FeetToMm(o.X)
			y = FeetToMm(o.Y)
			z = FeetToMm(o.Z)
			output.append([element.Id.IntegerValue,connector.Id,x,y,z])

# Start Transaction
TransactionManager.Instance.EnsureInTransaction(doc)


# End Transaction
TransactionManager.Instance.TransactionTaskDone()

#output = sorted(output)
#output.insert(0,["Element ID","Connector ID","X [mm]","Y [mm]","Z [mm]"])

OUT = output
# ----------------------------------------
Run = Input()
python_script = Python(IN[0]=Run)
# ---------- python_script.python (103 lines) ----------
#Copyright(c) 2016, Cesare Caoduro
# http://bimandothers.blogspot.com

import clr

# Import RevitAPI
clr.AddReference("RevitAPI")
import Autodesk
from Autodesk.Revit.DB import *

# Import DocumentManager and TransactionManager
clr.AddReference("RevitServices")
import RevitServices
from RevitServices.Persistence import DocumentManager
from RevitServices.Transactions import TransactionManager

# Import ToDSType(bool) extension method
clr.AddReference("RevitNodes")
import Revit
clr.ImportExtensions(Revit.Elements)
clr.ImportExtensions(Revit.GeometryConversion)

import clr
clr.AddReference('ProtoGeometry')
from Autodesk.DesignScript.Geometry import *


def FeetToMm(d):
	return d * 304.8
	
def MmToFeet(d):
	return d / 304.8
	
def MtoFeet(d):
	return d / 0.3048
	
#The input to this node will be stored in the IN[0] variable.

doc =  DocumentManager.Instance.CurrentDBDocument
app =  DocumentManager.Instance.CurrentUIApplication.Application


output = []




collector = FilteredElementCollector(doc)
collector.OfCategory(BuiltInCategory.OST_MechanicalEquipment)

famtypeitr = collector.GetElementIdIterator()
famtypeitr.Reset()
tr = doc.ActiveProjectLocation.GetTotalTransform()



runme = IN[0]
if runme:
	level = []
	size = []
	length = []
	elevation = []
	description = []
	curves = []
	pointlist = []
	connectors = []
	levels = []
	elementids = []
	elevations = []
	descriptions = []
	items = []
	for item in famtypeitr:
		elmID = item
		eleminst = doc.GetElement(elmID)
		
		for p in eleminst.Parameters:
			if p.Definition.Name == 'Level':
				level = p.AsValueString()
			if p.Definition.Name == 'Description':
				description = p.AsString()
			if p.Definition.Name == 'Offset':
				elevation = p.AsDouble()
	
		elementid = eleminst.Id.ToString()
	
		if level:
			elementids.append(elementid)
			levels.append(level)
			elevations.append(elevation)
			descriptions.append(description)
			items.append(eleminst)
			loc = eleminst.Location
			pointlist.append(loc.Point.ToPoint())
	
	output.append(elementids)
	output.append(items)
	output.append(levels)
	output.append(elevations)
	output.append(descriptions)
	output.append(pointlist)
        
#Assign your output to the OUT variable
OUT = output
# ----------------------------------------
number = DoubleInput(1)
getItemAtIndex = List.GetItemAtIndex(list=python_script, index=number)
Elements = Output(getItemAtIndex)
number_2 = DoubleInput(2)
getItemAtIndex_2 = List.GetItemAtIndex(list=python_script, index=number_2)
Level_Name = Output(getItemAtIndex_2)
number_3 = DoubleInput(3)
getItemAtIndex_3 = List.GetItemAtIndex(list=python_script, index=number_3)
Elevation = Output(getItemAtIndex_3)
number_4 = DoubleInput(4)
getItemAtIndex_4 = List.GetItemAtIndex(list=python_script, index=number_4)
Description = Output(getItemAtIndex_4)
number_5 = DoubleInput(0)
getItemAtIndex_5 = List.GetItemAtIndex(list=python_script, index=number_5)
Element_ID = Output(getItemAtIndex_5)
number_6 = DoubleInput(5)
getItemAtIndex_6 = List.GetItemAtIndex(list=python_script, index=number_6)
Location = Output(getItemAtIndex_6)
