# Dynamo custom node Pipe Fittings Element Collector.dyf (Dynamo 1.0.0.1180)
# category: Dynamo4MEP.Collectors
# Pipe Fittings Element Collector

Run = Input()
python_script = Python(IN[0]=Run)
# ---------- python_script.python (122 lines) ----------
#Copyright(c) 2016, Cesare Caoduro
# http://bimandothers.blogspot.com

import clr

# Import RevitAPI
clr.AddReference("RevitAPI")
import Autodesk
from Autodesk.Revit.DB import *

# Import DocumentManager and TransactionManager
clr.AddReference("RevitServices")
import RevitServices
from RevitServices.Persistence import DocumentManager
from RevitServices.Transactions import TransactionManager

# Import ToDSType(bool) extension method
clr.AddReference("RevitNodes")
import Revit
clr.ImportExtensions(Revit.Elements)
clr.ImportExtensions(Revit.GeometryConversion)

import clr
clr.AddReference('ProtoGeometry')
from Autodesk.DesignScript.Geometry import *


def FeetToMm(d):
	return d * 304.8
	
def MmToFeet(d):
	return d / 304.8
	
def MtoFeet(d):
	return d / 0.3048
	
#The input to this node will be stored in the IN[0] variable.

doc =  DocumentManager.Instance.CurrentDBDocument
app =  DocumentManager.Instance.CurrentUIApplication.Application


output = []

collector = FilteredElementCollector(doc)
collector.OfCategory(BuiltInCategory.OST_PipeFitting)

famtypeitr = collector.GetElementIdIterator()
famtypeitr.Reset()
tr = doc.ActiveProjectLocation.GetTotalTransform()

runme = IN[0]
if runme:
	level = []
	size = []
	length = []
	elevation = []
	description = []
	items = []
	
	levels = []
	elementids = []
	sizes = []
	lengths = []
	elevations = []
	descriptions = []
	connectors = []
	angles = []
	for item in famtypeitr:
		elmID = item
		eleminst = doc.GetElement(elmID)
		
		for p in eleminst.Parameters:
			if p.Definition.Name == 'Level':
				level = p.AsValueString()
			if p.Definition.Name == 'Description':
				description = p.AsString()
			if p.Definition.Name == 'Size':
				size = p.AsString()
			#if p.Definition.Name == 'Length':
				#length = p.AsDouble()
			if p.Definition.Name == 'Offset':
				elevation = p.AsDouble()
			if p.Definition.Name == 'Angle':
				angle = p.AsValueString()
	
		elementid = eleminst.Id.ToString()
	
		if level:
			elementids.append(elementid)
			levels.append(level)
			sizes.append(size)
			lengths.append(length)
			elevations.append(elevation)
			descriptions.append(description)
			angles.append(angle)
			loc = eleminst.Location
			connector = []
			for c in eleminst.MEPModel.ConnectorManager.Connectors:
				o = c.Origin
				o = tr.Inverse.OfPoint(o)
				x = FeetToMm(o.X)
				y = FeetToMm(o.Y)
				z = FeetToMm(o.Z)
				point = Point.ByCoordinates(x, y, z)
				connector.append(point)
			connectors.append(connector)
			items.append(eleminst)
	
	output.append(items)
	output.append(elementids)
	output.append(levels)
	output.append(elevations)
	output.append(sizes)
	#output.append(lengths)
	output.append(descriptions)
	output.append(angles)
	output.append(connectors)
	
        
#Assign your output to the OUT variable
OUT = output
# ----------------------------------------
number = DoubleInput(4)
getItemAtIndex = List.GetItemAtIndex(list=python_script, index=number)
Size = Output(getItemAtIndex)
number_2 = DoubleInput(5)
getItemAtIndex_2 = List.GetItemAtIndex(list=python_script, index=number_2)
Length = Output(getItemAtIndex_2)
number_3 = DoubleInput(0)
getItemAtIndex_3 = List.GetItemAtIndex(list=python_script, index=number_3)
Elements = Output(getItemAtIndex_3)
number_4 = DoubleInput(6)
getItemAtIndex_4 = List.GetItemAtIndex(list=python_script, index=number_4)
Angle = Output(getItemAtIndex_4)
number_5 = DoubleInput(2)
getItemAtIndex_5 = List.GetItemAtIndex(list=python_script, index=number_5)
Level_Name = Output(getItemAtIndex_5)
number_6 = DoubleInput(1)
getItemAtIndex_6 = List.GetItemAtIndex(list=python_script, index=number_6)
Element_ID = Output(getItemAtIndex_6)
number_7 = DoubleInput(3)
getItemAtIndex_7 = List.GetItemAtIndex(list=python_script, index=number_7)
Elevation = Output(getItemAtIndex_7)
number_8 = DoubleInput(7)
getItemAtIndex_8 = List.GetItemAtIndex(list=python_script, index=number_8)
Connectors = Output(getItemAtIndex_8)
Description = Output(getItemAtIndex_2)
