# Dynamo custom node Export Structural Columns.dyf (Dynamo 0.7.5.3881)
# category: Chris.Export
# Export Structural Columns from the current model to an Excel file (input .xlsx path)

Input = Input()
string = StringInput("Sheet1")
number = DoubleInput(0)
categories = Categories("StructuralColumns")
all_elements_of_category = ElementsOfCategory(categories)
name = Element.Name(all_elements_of_category)
id = Element.Id(all_elements_of_category)
uniqueId = Element.UniqueId(all_elements_of_category)
string_2 = StringInput("Mark")
getParameterValueByName = Element.GetParameterValueByName(all_elements_of_category, string_2)
create = List.Create(name, id, uniqueId, getParameterValueByName)
transpose = List.Transpose(create)
watch = Watch(transpose)
writeToFile = Excel.WriteToFile(Input, string, number, number, watch)
