# Dynamo custom node AttachToStructure.dyf (Dynamo 1.3.2.2480)
# category: Fabrication
# Attach Fabrication hanger rod ends to nearest structural member.

FabricationPart_s = Input()  # "FabricationPart(s)"; Hangers only.
count = Count(FabricationPart_s)
attachToStructure = Python(IN[0]=FabricationPart_s, IN[1]=count)
# ---------- attachToStructure.python (31 lines) ----------
import clr
clr.AddReference("RevitAPI")
import Autodesk
from Autodesk.Revit.DB import FabricationPart
from Autodesk.Revit.DB import FabricationRodInfo

clr.AddReference("RevitNodes")
import Revit
clr.ImportExtensions(Revit.Elements)

clr.AddReference("RevitServices")
import RevitServices
from RevitServices.Persistence import DocumentManager
from RevitServices.Transactions import TransactionManager

Inpt = UnwrapElement(IN[0])
Cnt = UnwrapElement(IN[1])
f = list()

Doc = DocumentManager.Instance.CurrentDBDocument
TransactionManager.Instance.EnsureInTransaction(Doc)

if Cnt > 1:
	for e in Inpt:
		f.append(e.GetRodInfo().AttachToStructure())
else:
	f.append(Inpt.GetRodInfo().AttachToStructure())

TransactionManager.Instance.TransactionTaskDone()

OUT = f#Inpt, DimName, DimValue, ItmDims
# ----------------------------------------
OUT = Output(attachToStructure)
