# Dynamo custom node Fabrication Part Dimensions.dyf (Dynamo 1.3.2.2480)
# category: Fabrication
# Retrieve an array of FabricationPart dimensions.

FabricationPart_s = Input()  # "FabricationPart(s)"
count = Count(FabricationPart_s)
fabrication_part_dimensions = Python(IN[0]=FabricationPart_s, IN[1]=count)
# ---------- fabrication_part_dimensions.python (45 lines) ----------
import clr
clr.AddReference('RevitAPI')
import Autodesk
from Autodesk.Revit.DB import FabricationPart
from Autodesk.Revit.DB import FabricationDimensionDefinition
from Autodesk.Revit.DB import FabricationDimensionUnitType

clr.AddReference("RevitNodes")
import Revit
clr.ImportExtensions(Revit.Elements)

clr.AddReference("RevitServices")
import RevitServices
from RevitServices.Persistence import DocumentManager
from RevitServices.Transactions import TransactionManager

Inpt = UnwrapElement(IN[0])
Cnt = UnwrapElement(IN[1])
DimName = list()
DimVal = list()
DimType = list()
DimCnt = list()

Doc = DocumentManager.Instance.CurrentDBDocument
TransactionManager.Instance.EnsureInTransaction(Doc)

if Cnt > 1:
	for e in Inpt:
		DimObj = e.GetDimensions()
		DimCnt.append(len(DimObj))
		for n in DimObj:
			DimName.append(n.Name)
			DimVal.append(e.GetDimensionValue(n))
			DimType.append(n.UnitType)
else:
	DimObj = Inpt.GetDimensions()
	DimCnt.append(len(DimObj))
	for n in DimObj:
		DimName.append(n.Name)
		DimVal.append(Inpt.GetDimensionValue(n))
		DimType.append(n.UnitType)

TransactionManager.Instance.TransactionTaskDone()

OUT = DimName, DimVal, DimType, DimCnt
# ----------------------------------------
code_block = CodeBlock { 0; 1; 2; 3; }
getItemAtIndex = List.GetItemAtIndex(list=fabrication_part_dimensions, index=code_block.out3)
getItemAtIndex_2 = List.GetItemAtIndex(list=fabrication_part_dimensions, index=code_block.out2)
create = List.Create(getItemAtIndex)
flatten = Flatten(create)
python_script = Python(IN[0]=getItemAtIndex_2, IN[1]=flatten)
# ---------- python_script.python (15 lines) ----------
import clr

inputlist = IN[0]
listlengths = IN[1]
rowcounter = 0
elementlist = list()
for item in listlengths:
	itemcounter = 0
	itemlist = list()
	while itemcounter < item:
		itemlist.append(inputlist[rowcounter])
		rowcounter += 1
		itemcounter += 1
	elementlist.append(itemlist)
OUT = elementlist
# ----------------------------------------
python_script_2 = Python(IN[0]=getItemAtIndex, IN[1]=python_script)
# ---------- python_script_2.python (4 lines) ----------
check = IN[0]
items = IN[1]
if isinstance(check, (list)): OUT = items
else: OUT = items[0]
# ----------------------------------------
DimType = Output(python_script_2)
getItemAtIndex_3 = List.GetItemAtIndex(list=fabrication_part_dimensions, index=code_block.out1)
create_2 = List.Create(getItemAtIndex)
flatten_2 = Flatten(create_2)
python_script_3 = Python(IN[0]=getItemAtIndex_3, IN[1]=flatten_2)  # same code as python_script
python_script_4 = Python(IN[0]=getItemAtIndex, IN[1]=python_script_3)  # same code as python_script_2
DimValue = Output(python_script_4)
getItemAtIndex_4 = List.GetItemAtIndex(list=fabrication_part_dimensions, index=code_block.out0)
create_3 = List.Create(getItemAtIndex)
flatten_3 = Flatten(create_3)
python_script_5 = Python(IN[0]=getItemAtIndex_4, IN[1]=flatten_3)  # same code as python_script
python_script_6 = Python(IN[0]=getItemAtIndex, IN[1]=python_script_5)  # same code as python_script_2
DimName = Output(python_script_6)
