# Dynamo custom node FabricationPart.IsSameAs.dyf (Dynamo 1.3.2.2480)
# category: Fabrication
# Groups FabricationParts into sublists of identical parts, as determined by optional ignoreFields.

FabricationParts = Input()  # A list of FabricationParts to compare.
count = Count(FabricationParts)
ignoreFields = Input(ignoreFields = List.OfRepeatedItem(false, 28))  # An optional list of boolean values in order, corresponding to the FabricationPartCompareType Enumeration as follows:  [0]  CutType [1]  Material [2]  Specification [3]  InsulationSpecification [4]  MaterialGauge [5]  DuctFacing [6]  Insulation [7]  Notes [8]  Filename [9]  Description [10] CID [11] SkinMaterial [12] SkinGauge [13] Section [14] Status [15] Service [16] Pallet [17] BoxNo [18] OrderNo [19] Drawing [20] Zone [21] ETag [22] Alt [23] Spool [24] Alias [25] PCFKey [26] CustomData [27] ButtonAlias  Each instance of "true" in the input list indicates that the FabricationPart.IsSameAs method will ignore differences in the ignoreField corresponding to index.  For Example, a value of "true" at index 15 of the input list indicates that the "Service" of FabricationParts will not be considered when determining if they are the same; meaning that parts accross different services may be determined as being identical, if they otherwise are; so that, for example, the same Item Number can be applied to all items in each sublist contained in the output.  If no input is given, a default list of 28 "false" values is used, which means all 28 fields are compared.
isSameAs = Python(IN[0]=FabricationParts, IN[1]=FabricationParts, IN[2]=count, IN[3]=ignoreFields)  # "FabricationPart.IsSameAs"
# ---------- isSameAs.python (60 lines) ----------
#Copyright(c) 2017, Nathan Chapman
# nchapman@generalheating.com

import clr
clr.AddReference('RevitAPI')
import Autodesk
from itertools import compress
from System.Collections.Generic import List
from Autodesk.Revit.DB import FabricationPart
from Autodesk.Revit.DB.Fabrication import *

Inpt = UnwrapElement(IN[0])
Cmp = UnwrapElement(IN[1])
Cnt = UnwrapElement(IN[2])
IgnBool = UnwrapElement(IN[3])
ItmList = list()
ignoreFields = List[FabricationPartCompareType]()
ignoreFields.Add(FabricationPartCompareType.CutType)
ignoreFields.Add(FabricationPartCompareType.Material)
ignoreFields.Add(FabricationPartCompareType.Specification)
ignoreFields.Add(FabricationPartCompareType.InsulationSpecification)
ignoreFields.Add(FabricationPartCompareType.MaterialGauge)
ignoreFields.Add(FabricationPartCompareType.DuctFacing)
ignoreFields.Add(FabricationPartCompareType.Insulation)
ignoreFields.Add(FabricationPartCompareType.Notes)
ignoreFields.Add(FabricationPartCompareType.Filename)
ignoreFields.Add(FabricationPartCompareType.Description)
ignoreFields.Add(FabricationPartCompareType.CID)
ignoreFields.Add(FabricationPartCompareType.SkinMaterial)
ignoreFields.Add(FabricationPartCompareType.SkinGauge)
ignoreFields.Add(FabricationPartCompareType.Section)
ignoreFields.Add(FabricationPartCompareType.Status)
ignoreFields.Add(FabricationPartCompareType.Service)
ignoreFields.Add(FabricationPartCompareType.Pallet)
ignoreFields.Add(FabricationPartCompareType.BoxNo)
ignoreFields.Add(FabricationPartCompareType.OrderNo)
ignoreFields.Add(FabricationPartCompareType.Drawing)
ignoreFields.Add(FabricationPartCompareType.Zone)
ignoreFields.Add(FabricationPartCompareType.ETag)
ignoreFields.Add(FabricationPartCompareType.Alt)
ignoreFields.Add(FabricationPartCompareType.Spool)
ignoreFields.Add(FabricationPartCompareType.Alias)
ignoreFields.Add(FabricationPartCompareType.PCFKey)
ignoreFields.Add(FabricationPartCompareType.CustomData)
ignoreFields.Add(FabricationPartCompareType.ButtonAlias)

IgnFld = list(compress(ignoreFields,IgnBool))

if Cnt > 1:
	for e in Inpt:
		CmpBool = list()
		for n in Cmp:
			CmpBool.append(e.IsSameAs(n,IgnFld))
		ItmList.append(list(compress(Inpt,CmpBool)))
else:
	CmpBool = list()
	for n in Cmp:
		CmpBool.append(Inpt.IsSameAs(n,IgnFld))
	ItmList.append(list(compress(Inpt,CmpBool)))
OUT = ItmList, IgnFld
# ----------------------------------------
firstItem = List.FirstItem(isSameAs)
uniqueItems = List.UniqueItems(firstItem)
list = Output(uniqueItems)  # Sublists of FabricationPart(s) that are identical, or that differ only in the values of specified "ignoreFields". For example, if a list of boolean values with "true" at index 15
