# Dynamo custom node SetDimensionValue.dyf (Dynamo 1.3.2.2480)
# category: Fabrication
# Set dimension values for FabricationParts.

FabricationPart_s = Input()  # "FabricationPart(s)"
count = Count(FabricationPart_s)
DimIndex = Input(DimIndex : int)  # Index of the dimension to modify. For example: The Index of "Width In" for CID 2 is 0
DimValue = Input(DimValue : double)  # Value in feet for linear dimensions, or in radians for angular dimensions.
set_dimension_value_s = Python(IN[0]=FabricationPart_s, IN[1]=count, IN[2]=DimIndex, IN[3]=DimValue)
# ---------- set_dimension_value_s.python (35 lines) ----------
import clr
clr.AddReference("RevitAPI")
import Autodesk
from Autodesk.Revit.DB import FabricationPart
from Autodesk.Revit.DB import FabricationDimensionDefinition

clr.AddReference("RevitNodes")
import Revit
clr.ImportExtensions(Revit.Elements)

clr.AddReference("RevitServices")
import RevitServices
from RevitServices.Persistence import DocumentManager
from RevitServices.Transactions import TransactionManager

Inpt = UnwrapElement(IN[0])
Cnt = UnwrapElement(IN[1])
DimName = UnwrapElement(IN[2])
DimValue = UnwrapElement(IN[3])
f = list()

Doc = DocumentManager.Instance.CurrentDBDocument
TransactionManager.Instance.EnsureInTransaction(Doc)

if Cnt > 1:
	for e in Inpt:
		ItmDims = e.GetDimensions()
		f.append(e.SetDimensionValue(ItmDims[DimName], DimValue))
else:
	ItmDims = Inpt[0].GetDimensions()
	f.append(Inpt[0].SetDimensionValue(ItmDims[DimName], DimValue))

TransactionManager.Instance.TransactionTaskDone()

OUT = f#Inpt, DimName, DimValue, ItmDims
# ----------------------------------------
