# Dynamo custom node Family.InRoom.dyf (Dynamo 0.7.6.3982)
# category: KOP.FAMILIES
# checks if given families are in rooms

Families = Input()
create = List.Create(Families)
Rooms = Input()
create_2 = List.Create(Rooms)
inRoom = Python(IN[0]=create, IN[1]=create_2)  # "Family.InRoom"
# ---------- inRoom.python (98 lines) ----------
"""
Copyright Peter Kompolschek 2015
finds elements in rooms
"""
import sys
import clr
clr.AddReference('ProtoGeometry')
from Autodesk.DesignScript.Geometry import *
# Import ToDSType(bool) extension method
clr.AddReference("RevitNodes")
import Revit
clr.ImportExtensions(Revit.Elements)
# Import geometry conversion extension methods
clr.ImportExtensions(Revit.GeometryConversion)
# Import DocumentManager and TransactionManager
clr.AddReference("RevitServices")
import RevitServices
from RevitServices.Persistence import DocumentManager
from RevitServices.Transactions import TransactionManager
from System.Collections.Generic import *
# Import RevitAPI
clr.AddReference("RevitAPI")
import Autodesk
from Autodesk.Revit.DB import *
#initialise lists and parameters
#librarypaths

#unitconversion 
m1 = 0.3048
m2 = m1**2
m3 = m1**3
#lists
families = []
elements=[]
rooms=[]
inroomlist=[]
noroomlist=[]
groups=[]
pointlist=[]
doc =  DocumentManager.Instance.CurrentDBDocument
app =  DocumentManager.Instance.CurrentUIApplication.Application

#parameters

#external functions

# load elements, flatten list and unwrap revit elements
for x in IN[0]:
    for y in x:
    	elements.append(UnwrapElement(y))
    for elemId in elements:
    	elem=doc.GetElement(elemId)
    	if "Group" in elem.Name:
       		groups.append(elem)
       	else:
       		families.append(elem)
elements=[]       
for x in IN[1]:
    for y in x:
	elements.append(UnwrapElement(y))
for i in elements:
	if i.Area>0:
		rooms.append(i)
	
for family in families:
	point= family.Location.Point
	flag=0
	for room in rooms:
		if room.IsPointInRoom(point):
			#fmly=family.GetType().Name
			fmly=family.Symbol.Family
			name=room.get_Parameter('Name').AsString()
			number=room.get_Parameter('Number').AsString()
			inroomlist.append((fmly,name,number))
			
			flag=1
	if flag==0:
		noroomlist.append(family.Symbol.Family)
for group in groups:
	bounding=group.get_BoundingBox(None)
	max=bounding.Max
	min=bounding.Min
	point=(bounding.Min+bounding.Max)/2

	flag=0
	for room in rooms:
		if room.IsPointInRoom(point):
			#fmly=family.GetType().Name
			fmly=group.Name
			name=room.get_Parameter('Name').AsString()
			number=room.get_Parameter('Number').AsString()
			inroomlist.append((fmly,name,number))
			
			flag=1
	if flag==0:
		noroomlist.append(group.Name)

OUT=inroomlist,noroomlist
# ----------------------------------------
code_block = CodeBlock { 0; 1; }
getItemAtIndex = List.GetItemAtIndex(inRoom, code_block.out0)
flatten = Flatten(getItemAtIndex)
code_block_2 = CodeBlock { 3; 2; 1; 0; }
name = List.TakeEveryNthItem(flatten, code_block_2.out0, code_block_2.out1)  # "Room.Name"
Room_Names = Output(name)  # "Room.Names"
number = List.TakeEveryNthItem(flatten, code_block_2.out0, code_block_2.out3)  # "Room.Number"
Room_Numbers = Output(number)  # "Room.Numbers"
name_2 = List.TakeEveryNthItem(flatten, code_block_2.out0, code_block_2.out2)  # "Furniture.Name"
Family_Names = Output(name_2)  # "Family.Names"
notInRoom = List.GetItemAtIndex(inRoom, code_block.out1)  # "Furniture.NotInRoom"
Families_NotInRooms = Output(notInRoom)  # "Families.NotInRooms"
