# Dynamo custom node Find Wall Material Areas.dyf (Dynamo 0.7.5.3271)
# category: LD
# Input wall elements to find areas of the materials associated with each wall element.

# note: Output format is as:
# [Wall Type]
#  [Material]
#  [Area]
# Each Wall Type should have a number of lists below them which corresponds to the number of materials. If a material is used more than once in a wall, the areas for each will be added together giving total areas for that material.
# Areas are in square meters.
Wall_Elements = Input()
python_script = Python(IN[0]=Wall_Elements)
# ---------- python_script.python (49 lines) ----------
import clr
clr.AddReference('RevitAPI')
from Autodesk.Revit.DB import *
from itertools import izip

# Import DocumentManager
clr.AddReference("RevitServices")
import RevitServices
from RevitServices.Persistence import DocumentManager
from RevitServices.Transactions import TransactionManager

doc = DocumentManager.Instance.CurrentDBDocument

TransactionManager.Instance.EnsureInTransaction(doc)

walls = UnwrapElement(IN[0])
		
ids = []
materials = []
areas = []
comb = []
wallnames = []
output = []
count = 0

for wall in walls:
	materialid = wall.GetMaterialIds(False)
	ids.append(materialid)
	
#flatids = [item for sublist in ids for item in sublist]

for i in ids:
	comb.append(walls[count].Name)
	wallnames.append(walls[count].Name)
	for area in i:
		matarea = (walls[count].GetMaterialArea(area, False)) * 0.09290304
		areas.append(matarea)
		comb.append([doc.GetElement(area).Name, matarea])	
		materials.append(doc.GetElement(area).Name)	
	count += 1

output.append(comb)
output.append(wallnames)
output.append(materials)
output.append(areas)
			
TransactionManager.Instance.TransactionTaskDone()

OUT = output
# ----------------------------------------
code_block = CodeBlock { 0; 1; 2; 3; }
getItemAtIndex = List.GetItemAtIndex(python_script, code_block.out0)
Wall_Material_Area = Output(getItemAtIndex)  # "[Wall][Material,Area]"
getItemAtIndex_2 = List.GetItemAtIndex(python_script, code_block.out1)
Wall_Names = Output(getItemAtIndex_2)
getItemAtIndex_3 = List.GetItemAtIndex(python_script, code_block.out2)
Materials = Output(getItemAtIndex_3)
getItemAtIndex_4 = List.GetItemAtIndex(python_script, code_block.out3)
Areas = Output(getItemAtIndex_4)
