# Dynamo graph REPLACE ROOM NUMBERS (v2.0).dyn (Dynamo 1.2.2.373)

categories = Categories("Rooms")
all_elements_of_category = ElementsOfCategory(categories)
string = StringInput("Number")
number = Room.Number(all_elements_of_category)

# group: REPLACE
boolean = BoolSelector(true)
code_block = CodeBlock(False=boolean) { Run:bool=False; }
code_block_2 = CodeBlock { Default : string = "Old"; }
code_block_3 = CodeBlock { Prompt1 : string = "Find"; }
python_script = Python(IN[0]=code_block, IN[1]=code_block_2, IN[2]=code_block_3)
# ---------- python_script.python (93 lines) ----------
""" DynamoFormInput: TextInput
Ported from RevitPythonWrapper:
https://github.com/gtalarico/revitpythonwrapper
@gtalarico
"""

import clr
import sys
sys.path.append(r'C:\Program Files (x86)\IronPython 2.7\Lib')
sys.path.append(r'C:\Program Files (x86)\IronPython 2.7\Platforms\Net40')

try:
	clr.AddReference('System')
	clr.AddReference("PresentationFramework")
	clr.AddReference('IronPython.Wpf')
except IOError:
	raise

from System.Windows import Application, Window
from System.IO import StringReader

try:
	import wpf    
except ImportError:
	raise

class TextInput(Window):
    """
    WPF form with TextInput.

    Args:
        title (str): Title of form
        default ([str]): Default value for text box
        description (str): Description of input requested


    Usage:
        >>> prompt = TextInput('Title', default="3")
        >>> prompt.show()
        >>> print(prompt.selected)
    """

    LAYOUT = """
            <Window xmlns="http://schemas.microsoft.com/winfx/2006/xaml/presentation"
                    xmlns:x="http://schemas.microsoft.com/winfx/2006/xaml"
                    xmlns:d="http://schemas.microsoft.com/expression/blend/2008"
                    xmlns:mc="http://schemas.openxmlformats.org/markup-compatibility/2006"
                    xmlns:local="clr-namespace:WpfApplication1"
                    mc:Ignorable="d" Height="140.139" Width="325" ResizeMode="NoResize" Title="" WindowStartupLocation="CenterScreen" Topmost="True" SizeToContent="WidthAndHeight">
                <Grid Margin="10,0,10,10">
                    <Label x:Name="selection_label" Content="Select Item" HorizontalAlignment="Left" Height="30" VerticalAlignment="Top" Width="299"/>

                    <TextBox x:Name="text_box" HorizontalAlignment="Left" Margin="0,30,0,0" VerticalAlignment="Top" Width="299"/>

                    <Button x:Name="button_select" Content="Select" HorizontalAlignment="Left" Height="26" Margin="0,63,0,0" VerticalAlignment="Top" Width="299"/>

                </Grid>
            </Window>
            """

    def __init__(self, title, default=None, description=None):
        self.selected = None
        self.ui = wpf.LoadComponent(self, StringReader(TextInput.LAYOUT))
        self.ui.Title = title

        if default is not None:
            self.ui.text_box.Text = default

        if description is not None:
            self.ui.selection_label.Content = description
        self.ui.button_select.Click += self.select_click

    def select_click(self, sender, e):
        self.DialogResult = True
        self.selected = self.ui.text_box.Text
        self.Close()

###################################################################
# Dynamo Interface for RPW Form
###################################################################

run = IN[0]
default_value = IN[1]
description = IN[2]

if run:
	form = TextInput('Dynamo Form Input', description=description, default=default_value)
	form.ShowDialog()
	if form.selected is not None:
		OUT = form.selected
else:
	OUT = 'Set RUN to True'
	
# ----------------------------------------
code_block_4 = CodeBlock(Selected=python_script) { Selected; }

# group: FIND
boolean_2 = BoolSelector(true)
code_block_5 = CodeBlock(False=boolean_2) { Run:bool=False; }
code_block_6 = CodeBlock { Default : string = "New"; }
code_block_7 = CodeBlock { Prompt1 : string = "Replace With"; }
python_script_2 = Python(IN[0]=code_block_5, IN[1]=code_block_6, IN[2]=code_block_7)  # same code as python_script
code_block_8 = CodeBlock(Selected=python_script_2) { Selected; }

replace = String.Replace(str=number, searchFor=code_block_4, replaceWith=code_block_8)
setParameterByName = Element.SetParameterByName(element=all_elements_of_category, parameterName=string, value=replace)
