# Dynamo custom node Foundation Rebar.dyf (Dynamo 0.9.0.3067)
# category: Revit.Rebar
# Standard Rebar for Foundations

HostElement = Input(HostElement: Element)
# note: Select Bottom Face
SurfaceBottom = Input(SurfaceBottom: Surface)
# note: Select Top Face
SurfaceTop = Input(SurfaceTop: Surface)

# group: Create Horizontal Planes across the Element
code_block = CodeBlock { 0.5; }
pointAtParameter = Surface.PointAtParameter(surface=SurfaceBottom, u=code_block, v=code_block, lacing=CrossProduct)
ZAxis = Vector.ZAxis()
byOriginNormal = Plane.ByOriginNormal(origin=pointAtParameter, normal=ZAxis)
pointAtParameter_2 = Surface.PointAtParameter(surface=SurfaceTop, u=code_block, v=code_block, lacing=CrossProduct)
byStartPointEndPoint = Line.ByStartPointEndPoint(startPoint=pointAtParameter_2, endPoint=pointAtParameter)
length = Curve.Length(byStartPointEndPoint)
StirrupDistance = Input(StirrupDistance: double)
code_block_2 = CodeBlock(height=length, step=StirrupDistance) { n=(height-2*step)/step+1; step..height-step..#n; }
offset = Plane.Offset(byOriginNormal, code_block_2.out1, lacing=CrossProduct)
flatten = Flatten(offset)

# group: Get Geometry Outline
geometry = Element.Geometry(HostElement)
intersect = Geometry.Intersect(geometry=geometry, other=flatten, lacing=CrossProduct)
flatten_2 = Flatten(intersect)
perimeterCurves = Surface.PerimeterCurves(flatten_2)

# group: Fillet Edges
byJoinedCurves = PolyCurve.ByJoinedCurves(perimeterCurves)
StirrupRadius = Input(StirrupRadius: double)
boolean = BoolSelector(true)
fillet = PolyCurve.Fillet(byJoinedCurves, StirrupRadius, boolean)
boolean_2 = BoolSelector(false)
fillet_2 = PolyCurve.Fillet(byJoinedCurves, StirrupRadius, boolean_2)
join = List.Join(fillet, fillet_2)

# group: Proceed only with results containing more than 7 curves
numberOfCurves = PolyCurve.NumberOfCurves(join)
code_block_3 = CodeBlock { 8; }
lt = numberOfCurves < code_block_3
filterByBoolMask = List.FilterByBoolMask(list=join, mask=lt)

# group: Drop one of the corners
curves = PolyCurve.Curves(filterByBoolMask.out)
code_block_4 = CodeBlock { -1; }
dropItems = List.DropItems(amount=code_block_4)
map = List.Map(list=curves, f_x=dropItems)
byJoinedCurves_2 = PolyCurve.ByJoinedCurves(map)

id = Element.Id(HostElement)

# group: Create Stirrups
code_block_5 = CodeBlock { "StirrupTie"; }
StirrupBarType = Input(StirrupBarType: Element)
StirrupHookOrientation = Input(StirrupHookOrientation: string)
StirrupHookType = Input(StirrupHookType: Element)
ZAxis_2 = Vector.ZAxis()
byCurve = Rebar.ByCurve(byJoinedCurves_2, id, code_block_5, StirrupBarType, StirrupHookOrientation, StirrupHookOrientation, StirrupHookType, StirrupHookType, ZAxis_2)
Stirrups = Output(byCurve)

# group: Offset Vertical Surfaces for Cover Parameter
perimeterCurves_2 = Surface.PerimeterCurves(SurfaceBottom)
byJoinedCurves_3 = PolyCurve.ByJoinedCurves(perimeterCurves_2)
VericalBarsCover = Input(VericalBarsCover: double)
boolean_3 = BoolSelector(false)
offset_2 = PolyCurve.Offset(byJoinedCurves_3, VericalBarsCover, boolean_3)
byPatch = Surface.ByPatch(offset_2)
perimeterCurves_3 = Surface.PerimeterCurves(SurfaceTop)
byJoinedCurves_4 = PolyCurve.ByJoinedCurves(perimeterCurves_3)
offset_3 = PolyCurve.Offset(byJoinedCurves_4, VericalBarsCover, boolean_3)
byPatch_2 = Surface.ByPatch(offset_3)

# group: Divide V Surfaces
VerticalBarsAmount = Input(VerticalBarsAmount: double)
code_block_6 = CodeBlock(n=VerticalBarsAmount) { 0..1..#n; }
pointAtParameter_3 = Surface.PointAtParameter(surface=byPatch, u=code_block_6, v=code_block_6, lacing=CrossProduct)
pointAtParameter_4 = Surface.PointAtParameter(surface=byPatch_2, u=code_block_6, v=code_block_6, lacing=CrossProduct)

# group: Create Curvature
flatten_3 = Flatten(pointAtParameter_3)
X = Point.X()
sortByFunction = SortByFunction(flatten_3, X)
Y = Point.Y()
sortByFunction_2 = SortByFunction(sortByFunction, Y)
flatten_4 = Flatten(pointAtParameter_4)
X_2 = Point.X()
sortByFunction_3 = SortByFunction(flatten_4, X_2)
Y_2 = Point.Y()
sortByFunction_4 = SortByFunction(sortByFunction_3, Y_2)
byStartPointEndPoint_2 = Line.ByStartPointEndPoint(startPoint=sortByFunction_2, endPoint=sortByFunction_4)

# group: Create Hooks
create = List.Create()
byTwoPoints = Vector.ByTwoPoints(start=sortByFunction_2, end=pointAtParameter, lacing=CrossProduct)
flatten_5 = Flatten(byTwoPoints)
VerticalBarsHookLength = Input(VerticalBarsHookLength: double)
byStartPointDirectionLength = Line.ByStartPointDirectionLength(startPoint=sortByFunction_2, direction=flatten_5, length=VerticalBarsHookLength)
combine = List.Combine(create, byStartPointEndPoint_2, byStartPointDirectionLength)
byJoinedCurves_5 = PolyCurve.ByJoinedCurves()
map_2 = List.Map(list=combine, f_x=byJoinedCurves_5)
VerticalBarsBendingRadius = Input(VerticalBarsBendingRadius: double)
fillet_3 = PolyCurve.Fillet(map_2, VerticalBarsBendingRadius)

# group: Create Verical Bars
code_block_7 = CodeBlock { "Standard"; }
VerticalBarsBarType = Input(VerticalBarsBarType:Element)
code_block_8 = CodeBlock { "Left"; }
rebar_hook_type = RevitRebarHookType("None")
normal = Curve.Normal(fillet_3)
byCurve_2 = Rebar.ByCurve(fillet_3, id, code_block_7, VerticalBarsBarType, code_block_8, code_block_8, rebar_hook_type, rebar_hook_type, normal)
Bars = Output(byCurve_2)
