# Dynamo custom node All Elements Of Types In Document.dyf "All Elements of Types in Document" (Dynamo 1.3.4.6666)
# category: GeniusLoci.Select
# Collect all elements of a type in a given document.

elementType = Input()
docOrRevitLinkInstance = Input(docOrRevitLinkInstance : var = null)  # Use only if you want to query a linked model
element_types_in_document = Python(IN[0]=elementType, IN[1]=docOrRevitLinkInstance)
# ---------- element_types_in_document.python (25 lines) ----------
import clr
clr.AddReference('RevitAPI')
import Autodesk
from Autodesk.Revit.DB import *

clr.AddReference('RevitServices')
import RevitServices
from RevitServices.Persistence import DocumentManager

elementType = IN[0]
inputdocs = UnwrapElement(IN[1]) if isinstance(IN[1],list) else [UnwrapElement(IN[1])]

#Part of script from Clockwork
for inputdoc in inputdocs :
	if inputdoc == None:
		doc = DocumentManager.Instance.CurrentDBDocument
	elif inputdoc.GetType().ToString() == "Autodesk.Revit.DB.Document":
		doc = inputdoc
	elif inputdoc.GetType().ToString() == "Autodesk.Revit.DB.RevitLinkInstance":
		doc = inputdoc.GetLinkDocument()
	else: doc = None

elements = FilteredElementCollector(doc).OfClass(elementType).ToElements()

OUT = elements, doc
# ----------------------------------------
code_block = CodeBlock(x=element_types_in_document) { x[0]; x[1]; }
Element = Output(code_block.out0)
Document = Output(code_block.out1)
