# Dynamo custom node AppearanceAsset Duplicate.dyf (Dynamo 1.3.4.6666)
# category: GeniusLoci.Material
# Works only in Revit 2018.1 and later.
# Duplicates an AppearanceAsset Element.

AppearanceAsset = Input()
Name = Input()  # String
duplicateAssetElements = Python(IN[0]=AppearanceAsset, IN[1]=Name)
# ---------- duplicateAssetElements.python (26 lines) ----------
#Alban de Chasteigner 2018
#twitter : @geniusloci_bim
#geniusloci.bim@gmail.com

import clr
clr.AddReference('RevitAPI')
from Autodesk.Revit.DB import *
clr.AddReference('RevitServices')
import RevitServices
from RevitServices.Persistence import DocumentManager
from RevitServices.Transactions import TransactionManager
doc = DocumentManager.Instance.CurrentDBDocument

def toList(obj):
    if hasattr(obj, '__iter__'): return obj
    else: return [obj]
    
assetElems = toList(UnwrapElement(IN[0]))
assetElemNames = toList(IN[1])
duplicateAssetElements=[]
TransactionManager.Instance.EnsureInTransaction(doc)
for assetElem,assetElemName in zip(assetElems,assetElemNames):
	duplicateAssetElement = assetElem.Duplicate(assetElemName)
	duplicateAssetElements.append(duplicateAssetElement)
TransactionManager.Instance.TransactionTaskDone()
OUT = duplicateAssetElements
# ----------------------------------------
AppearanceAsset_2 = Output(duplicateAssetElements)  # "AppearanceAsset"
