# Dynamo custom node Collector of AppearanceAsset.dyf (Dynamo 1.3.4.6666)
# category: GeniusLoci.Material
# Retrieves all the AppearanceAsset Elements in the model.

get_appearanceassetelement = Python()
# ---------- get_appearanceassetelement.python (24 lines) ----------
#Alban de Chasteigner 2018
#twitter : @geniusloci_bim
#geniusloci.bim@gmail.com

import clr
clr.AddReference('RevitServices')
from RevitServices.Persistence import DocumentManager
doc = DocumentManager.Instance.CurrentDBDocument

clr.AddReference('RevitNodes')
import Revit
clr.ImportExtensions(Revit.Elements)

clr.AddReference('RevitAPI')
from Autodesk.Revit.DB import *

names=[]

appearanceAssets = FilteredElementCollector(doc).OfClass(AppearanceAssetElement).ToElements()

for appearanceAsset in appearanceAssets :
	names.append(appearanceAsset.Name)

OUT = appearanceAssets,names
# ----------------------------------------
code_block = CodeBlock(x=get_appearanceassetelement) { x[0]; x[1]; }
AppearanceAsset = Output(code_block.out0)
AppearanceAsset_Names = Output(code_block.out1)
