# Dynamo custom node Collector of Levels.dyf (Dynamo 1.3.4.6666)
# category: GeniusLoci.Level
# Collects Levels in the active or given document.
# Based on a Lunchbox node.

docOrRevitLinkInstance = Input(docOrRevitLinkInstance : var = null)  # Use only if you want to query a linked model
python_script = Python(IN[0]=docOrRevitLinkInstance)
# ---------- python_script.python (67 lines) ----------
#Copyright(c) 2014, Nathan Miller
# The Proving Ground, http://theprovingground.org

import clr
# Import RevitAPI
clr.AddReference("RevitAPI")
import Autodesk
from Autodesk.Revit.DB import *

# Import DocumentManager and TransactionManager
clr.AddReference("RevitServices")
import RevitServices
from RevitServices.Persistence import DocumentManager
from RevitServices.Transactions import TransactionManager

# Import ToDSType(bool) extension method
clr.AddReference("RevitNodes")
import Revit
clr.ImportExtensions(Revit.Elements)
clr.ImportExtensions(Revit.GeometryConversion)

#Part of script from Clockwork
inputdoc = UnwrapElement(IN[0])
if inputdoc == None:
	doc = DocumentManager.Instance.CurrentDBDocument
elif inputdoc.GetType().ToString() == "Autodesk.Revit.DB.RevitLinkInstance":
	doc = inputdoc.GetLinkDocument()
elif inputdoc.GetType().ToString() == "Autodesk.Revit.DB.Document":
	doc = inputdoc
else: doc = None

output = []
levels = []
names = []
areas = []
elevations = []
elementids = []
uniqueids = []

collector = FilteredElementCollector(doc).OfCategory(BuiltInCategory.OST_Levels).OfClass(Level)
 
famtypeitr = collector.GetElementIdIterator()
famtypeitr.Reset()

for item in famtypeitr:
	famtypeID = item
	faminst = doc.GetElement(famtypeID)
    
	level = faminst
	levelname = faminst.Name
	elevation = faminst.Elevation
	elementid = faminst.Id
	uniqueid = faminst.UniqueId
    	
	levels.append(level)
	names.append(levelname)
	elevations.append(elevation)
	elementids.append(elementid)
	uniqueids.append(uniqueid)
        
output.append(levels)
output.append(names)
output.append(elevations)
output.append(elementids)
output.append(uniqueids)       
#Assign your output to the OUT variable
OUT = output
# ----------------------------------------
code_block = CodeBlock(x=python_script) { x[0]; x[1]; x[2]; x[3]; x[4]; }
Element = Output(code_block.out0)
Name = Output(code_block.out1)
Elevation = Output(code_block.out2)
Element_ID = Output(code_block.out3)
Unique_ID = Output(code_block.out4)
