# Dynamo custom node Collector of ViewSheetSets.dyf (Dynamo 1.3.4.6666)
# category: GeniusLoci.View
# Retrieve all available View Sets in the active or given document.
# Use with ViewSheetSet.Views from Clockwork package.
# Inspired by an archilab node.

docOrRevitLinkInstance = Input(docOrRevitLinkInstance : var = null)  # Use only if you want to query a linked model
RunIt = Input(RunIt:bool=true)
python_script = Python(IN[0]=docOrRevitLinkInstance, IN[1]=RunIt)
# ---------- python_script.python (30 lines) ----------
#Copyright(c) 2015, Konrad Sobon
# @arch_laboratory, http://archi-lab.net

import clr
clr.AddReference('ProtoGeometry')
from Autodesk.DesignScript.Geometry import *

# Import DocumentManager and TransactionManager
clr.AddReference("RevitServices")
import RevitServices
from RevitServices.Persistence import DocumentManager

# Import RevitAPI
clr.AddReference("RevitAPI")
import Autodesk
from Autodesk.Revit.DB import *

#Part of script from Clockwork
inputdoc = UnwrapElement(IN[0])
if inputdoc == None:
	doc = DocumentManager.Instance.CurrentDBDocument
elif inputdoc.GetType().ToString() == "Autodesk.Revit.DB.RevitLinkInstance":
	doc = inputdoc.GetLinkDocument()
elif inputdoc.GetType().ToString() == "Autodesk.Revit.DB.Document":
	doc = inputdoc
else: doc = None

vs = FilteredElementCollector(doc).OfClass(ViewSheetSet)

OUT = [i.Name for i in vs],[i for i in vs]
# ----------------------------------------
code_block = CodeBlock(Vs=python_script) { Vs[0]; Vs[1]; }
ViewSheetSet_s_names = Output(code_block.out0)  # "ViewSheetSet's names"
ViewSheetSets = Output(code_block.out1)
