# Dynamo custom node CollectorPlacedViews.dyf (Dynamo 1.3.3.4651)
# category: GeniusLoci.View
# This node will collect all views placed on sheets.

placed_views = Python()
# ---------- placed_views.python (56 lines) ----------
#From Springs
#From ReAnimation
#From Rhythm

import clr

clr.AddReference("RevitServices")
from RevitServices.Persistence import DocumentManager
doc = DocumentManager.Instance.CurrentDBDocument

clr.AddReference("RevitNodes")
import Revit
clr.ImportExtensions(Revit.Elements)

clr.AddReference("RevitAPI")
from Autodesk.Revit.DB import *

def tolist(obj1):
	if hasattr(obj1,"__iter__"): return obj1
	else: return [obj1]
	
sheet_views = []
onSheets, allScheds = [], []
sheetInstances = []
legends = []

sheets = FilteredElementCollector(doc).OfCategory(BuiltInCategory.OST_Sheets).ToElements()

schedSheets = FilteredElementCollector(doc).OfClass(ScheduleSheetInstance).ToElements()

# Code
for s in schedSheets:
	if s.IsTitleblockRevisionSchedule is False:
		onSheets.append(s.ScheduleId)

newList = list(set(onSheets))

for n in newList:
	sched = doc.GetElement(n)
	allScheds.append(sched)

for i in xrange(len(sheets) ):
	viewsid = sheets[i].GetAllPlacedViews()
	views = [doc.GetElement(v).ToDSType(True) for v in viewsid]
	sheet_views.append(views)
	s_id = sheets[i].Id.IntegerValue
	
	for i in UnwrapElement(views):
		if i.ViewType.ToString() == "Legend":
			legends.append(i)

	for i in UnwrapElement(views):
		if i.ViewType.ToString() != "Legend":
			sheetInstances.append(i)

OUT = legends, sheetInstances, allScheds
# ----------------------------------------
code_block = CodeBlock(list=placed_views) { DSCore.List.UniqueItems(list[0]); list[1]; list[2]; }
View = Output(code_block.out1)
Schedule = Output(code_block.out2)
Legend = Output(code_block.out0)
code_block_2 = CodeBlock(l1=code_block.out0, l2=code_block.out1, l3=code_block.out2) { DSCore.List.Flatten({l1,l2,l3},-1); }
All_Placed_Views = Output(code_block_2)
