# Dynamo custom node Create Compound System FamilyType.dyf (Dynamo 1.3.4.6666)
# category: GeniusLoci.CompoundStructure
# Creates a new compound wall, floor, roof or ceiling Type and assigns material, width and function.

ElementOrFamilyType = Input()  # To duplicate
NewName = Input(NewName:string[]..[])
material = Input()  # One material per layer
Thickness = Input(Thickness:double[]..[])  # One thickness per layer
LayerFunction = Input()  # String or MaterialFunctionAssignement Use the Enumerate LayerFunction node
NumberOfLayersExterior = Input(NumberOfLayersExterior:int=0)
NumberOfLayersInterior = Input(NumberOfLayersInterior:int=0)
python_script = Python(IN[0]=ElementOrFamilyType, IN[1]=NewName, IN[2]=material, IN[3]=Thickness, IN[4]=LayerFunction, IN[5]=NumberOfLayersExterior, IN[6]=NumberOfLayersInterior)
# ---------- python_script.python (72 lines) ----------
#Alban de Chasteigner 2019
#twitter : @geniusloci_bim
#geniusloci.bim@gmail.com

import clr
# Import RevitAPI Classes
clr.AddReference('RevitAPI')
import Autodesk
from Autodesk.Revit.DB import *

clr.AddReference('RevitNodes')
import Revit
clr.ImportExtensions(Revit.Elements)

clr.AddReference('RevitServices')
import RevitServices
from RevitServices.Persistence import DocumentManager
from RevitServices.Transactions import TransactionManager

import sys
pyt_path = r'C:\Program Files (x86)\IronPython 2.7\Lib'
sys.path.append(pyt_path)
import System

doc = DocumentManager.Instance.CurrentDBDocument

UIunit = Document.GetUnits(doc).GetFormatOptions(UnitType.UT_Length).DisplayUnits

def tolist(obj1):
    if hasattr(obj1,"__iter__"): return obj1
    else: return [obj1]

elements = tolist(UnwrapElement(IN[0]))
newfamTypeNames = tolist(IN[1])
materials = tolist(UnwrapElement(IN[2]))
widths = tolist(IN[3])
functions = tolist(IN[4])
exterior= IN[5]
interior= IN[6]

TransactionManager.Instance.EnsureInTransaction(doc)
for elem,newfamTypeName in zip(elements,newfamTypeNames):
	if isinstance(elem, ElementType):
		famType=elem
	elif isinstance(elem, Wall):
		famType = elem.WallType
	elif isinstance(elem, Floor):
		famType = elem.FloorType
	elif isinstance(elem, Roof) or isinstance(elem, FootPrintRoof) or isinstance(elem, ExtrusionRoof) or isinstance(elem, RoofBase) :
		famType = elem.RoofType
	elif isinstance(elem, Ceiling) or isinstance(elem, FaceWall) :
		famType = doc.GetElement(elem.GetTypeId())
	else:
		pass
	newfamType = famType.Duplicate(newfamTypeName)
	layers=[]
	for material,width,function in zip(materials,widths,functions):	
		if isinstance(function, Autodesk.Revit.DB.MaterialFunctionAssignment):
			layerFunction=function
		else:
			layerFunction=System.Enum.Parse(Autodesk.Revit.DB.MaterialFunctionAssignment, function)
		layers.append(CompoundStructureLayer((UnitUtils.ConvertToInternalUnits(width,UIunit)),layerFunction,material.Id))
	compound = CompoundStructure.CreateSimpleCompoundStructure(layers)
	compound.SetNumberOfShellLayers(ShellLayerType.Exterior, exterior)
	compound.SetNumberOfShellLayers(ShellLayerType.Interior, interior)
	if famType.ToString() != 'Autodesk.Revit.DB.WallType':
		compound.EndCap=EndCapCondition.NoEndCap
	else:
		pass
	newfamType.SetCompoundStructure(compound)
TransactionManager.Instance.TransactionTaskDone()
OUT = newfamType
# ----------------------------------------
FamilyType = Output(python_script)
