# Dynamo custom node Create DWG Export Setup.dyf (Dynamo 1.3.4.6666)
# category: GeniusLoci.CAD Export
# Create a DWG export settings with values of the given DWGExportOptions.

docOrRevitLinkInstance = Input(docOrRevitLinkInstance: var = null)  # Use only if you want to query other document
DWGExportSetupName = Input(DWGExportSetupName : string)
DWGExportOptions = Input()
createDWGExportOptions = Python(IN[0]=docOrRevitLinkInstance, IN[1]=DWGExportSetupName, IN[2]=DWGExportOptions)
# ---------- createDWGExportOptions.python (45 lines) ----------
#Alban de Chasteigner 2018
#twitter : @geniusloci_bim
#geniusloci.bim@gmail.com

import clr
clr.AddReference('RevitAPI')
import Autodesk
from Autodesk.Revit.DB import *

clr.AddReference("RevitNodes")
import Revit
clr.ImportExtensions(Revit.Elements)

clr.AddReference("RevitServices")
import RevitServices
from RevitServices.Persistence import DocumentManager
from RevitServices.Transactions import TransactionManager

def tolist(input):
	if isinstance(input,list):
		return input
	else:
		return [input]

inputdoc = tolist(UnwrapElement(IN[0]))

if inputdoc[0] == None:
    doc = DocumentManager.Instance.CurrentDBDocument
elif inputdoc[0].GetType().ToString() == "Autodesk.Revit.DB.Document":
    doc = inputdoc[0]
elif inputdoc[0].GetType().ToString() == "Autodesk.Revit.DB.RevitLinkInstance":
    doc = inputdoc[0].GetLinkDocument()
else: doc = DocumentManager.Instance.CurrentDBDocument

name = tolist(IN[1])
options = tolist(IN[2])
DWGExports = []

t = Transaction(doc,'create')
t.Start()
result = Autodesk.Revit.DB.ExportDWGSettings.Create(doc,name[0],options[0])
DWGExports.append(result)
t.Commit()

OUT = doc,DWGExports
# ----------------------------------------
code_block = CodeBlock(x=createDWGExportOptions) { x[0]; x[1]; }
Document = Output(code_block.out0)
ExportDwgSettings = Output(code_block.out1)
