# Dynamo custom node Create and Apply View Filter.dyf (Dynamo 1.3.3.4651)
# category: GeniusLoci.View
# Create a new View Filter with a BuiltInParameter string and apply it to the list of views.

Category = Input()  # As list
bipName = Input()  # As string list
ParameterValue = Input()
FilterName = Input(FilterName : string)
Views = Input()  # As list
create_filter_for_view = Python(IN[0]=Category, IN[1]=bipName, IN[2]=ParameterValue, IN[3]=FilterName, IN[4]=Views)
# ---------- create_filter_for_view.python (56 lines) ----------
#From Luke Johnson
#From awilliams
#From Jonathan.Olesen
#From Alban de Chasteigner

import clr
clr.AddReference('RevitAPI')
from Autodesk.Revit.DB import *

clr.AddReference("RevitNodes")
import Revit
clr.ImportExtensions(Revit.Elements)

clr.AddReference("RevitServices")
import RevitServices
from RevitServices.Persistence import DocumentManager
from RevitServices.Transactions import TransactionManager
import System
from System.Collections.Generic import List
doc = DocumentManager.Instance.CurrentDBDocument


cats = IN[0]
paramName = IN[1]
pValue = IN[2]
views = UnwrapElement(IN[4])
doc = DocumentManager.Instance.CurrentDBDocument
TransactionManager.Instance.EnsureInTransaction(doc)
castlst = []
for i in cats:
	castlst.append(ElementId(i.Id))

typedCatList = List[ElementId](castlst)
rules = []

builtInParams = System.Enum.GetValues(BuiltInParameter)
bipNames = []
outview = []
for i in builtInParams:
	bipNames.append(str(i))
bipDict = dict(zip(bipNames,builtInParams))
bips = [bipDict.get(p, "none") for p in paramName]

TransactionManager.Instance.EnsureInTransaction(doc)

for bip in bips:
	rules.append(ParameterFilterRuleFactory.CreateLessRule(ElementId(bip), pValue, 0.001))
	filter = ParameterFilterElement.Create(doc, IN[3], typedCatList, rules)

for view in views:
	view.AddFilter(filter.Id)
	outview.append(views)
	
TransactionManager.Instance.TransactionTaskDone()

OUT = outview[0],filter
# ----------------------------------------
code_block = CodeBlock(x=create_filter_for_view) { x[0]; x[1]; }
Views_2 = Output(code_block.out0)  # "Views"
View_Filter = Output(code_block.out1)
