# Dynamo custom node Delete Elements from document.dyf (Dynamo 1.3.3.4651)
# category: GeniusLoci.Document
# Delete the input list of elements from the given Revit document.
# The node returns the number of successfully deleted elements and their Ids as a string.
# From Springs

element = Input(element:var[])
Document = Input()
python_script = Python(IN[0]=element, IN[1]=Document)
# ---------- python_script.python (38 lines) ----------
#Copyright(c) 2016, Dimitar Venkov
# @5devene, dimitar.ven@gmail.com

import clr
clr.AddReference('RevitAPI')
from Autodesk.Revit.DB import*
clr.AddReference('RevitServices')
import RevitServices
from RevitServices.Persistence import DocumentManager
from RevitServices.Transactions import TransactionManager

def tolist(obj1):
	if hasattr(obj1,"__iter__"): return obj1
	else: return [obj1]

docs = tolist(IN[1])

for doc in docs:
	t = Transaction(doc,'delete')
	t.Start()

elems = UnwrapElement(tolist(IN[0]))

deleted, failed = [], []

for e in elems:
	id = None
	try:
		id = e.Id
		del_id = doc.Delete(id)
		deleted.extend([d.ToString() for d in del_id])
	except:
		if id is not None:
			failed.append(id.ToString() )
s = set(deleted)
failed1 = [x for x in failed if x not in s]
t.Commit()
OUT = len(deleted), ';'.join(deleted), ';'.join(failed1)
# ----------------------------------------
code_block = CodeBlock(d=python_script) { d[0]; d[1]; d[2]; }
count = Output(code_block.out0)
deletedIds_str = Output(code_block.out1)  # "deletedIds(str)"
failedIds_str = Output(code_block.out2)  # "failedIds(str)"
