# Dynamo custom node Dimension ByReferences.dyf (Dynamo 1.3.4.6666)
# category: GeniusLoci.Dimension
# Creates a new linear dimension from at least two geometric references of an object.

line = Input(line:Autodesk.DesignScript.Geometry.Curve[]..[])  # Location of the dimension
references = Input()  # Autodesk.Revit.DB.Reference
dimensionType = Input(dimensionType:var[]..[] = null)
view = Input(view:Revit.Elements.Views.View = Revit.Application.Document.Current.ActiveView)  # View to place dimension in
dimensionWithReference = Python(IN[0]=line, IN[1]=references, IN[2]=dimensionType, IN[3]=view)
# ---------- dimensionWithReference.python (48 lines) ----------
#Alban de Chasteigner 2019
#twitter : @geniusloci_bim
#geniusloci.bim@gmail.com

import clr
clr.AddReference('RevitAPI')
from Autodesk.Revit.DB import *

clr.AddReference('RevitNodes')
import Revit
clr.ImportExtensions(Revit.GeometryConversion)
clr.ImportExtensions(Revit.Elements)

clr.AddReference('RevitServices')
import RevitServices
from RevitServices.Persistence import DocumentManager
from RevitServices.Transactions import TransactionManager

doc = DocumentManager.Instance.CurrentDBDocument

def tolist(obj1):
    if hasattr(obj1,"__iter__"): return obj1
    else: return [obj1]

lines = tolist(IN[0])
references= IN[1]
dimensionType=tolist(UnwrapElement(IN[2]))[0]
view = tolist(UnwrapElement(IN[3]))[0]

elementsRef = ReferenceArray()
for reference in references :
	elementsRef.Append(reference)
	
TransactionManager.Instance.EnsureInTransaction(doc)
for line in lines:
	if doc.IsFamilyDocument == True :
		if IN[2]== None: 
			dim = doc.FamilyCreate.NewDimension(view, line.ToRevitType(), elementsRef).ToDSType(True)
		else:
			dim = doc.FamilyCreate.NewDimension(view, line.ToRevitType(), elementsRef,dimensionType).ToDSType(True)
	else:
		if IN[2]== None: 
			dim = doc.Create.NewDimension(view, line.ToRevitType(), elementsRef).ToDSType(True)
		else:
			dim = doc.Create.NewDimension(view, line.ToRevitType(), elementsRef,dimensionType).ToDSType(True)
TransactionManager.Instance.TransactionTaskDone()

OUT=dim
# ----------------------------------------
Dimension = Output(dimensionWithReference)
