# Dynamo custom node Element to Document.dyf (Dynamo 1.3.4.6666)
# category: GeniusLoci.Element
# Returns the Document in which the Element resides, the document's filename and filepath.

element = Input()
python_script = Python(IN[0]=element)
# ---------- python_script.python (20 lines) ----------
import clr
clr.AddReference('RevitAPI')
from Autodesk.Revit.DB import *
clr.AddReference('RevitServices')
import RevitServices
from RevitServices.Persistence import DocumentManager

elements=UnwrapElement(IN[0])

if not hasattr(elements, '__iter__'):
	elements = [elements]

docs,titles,paths = [],[],[]
for element in elements:
    docs.append(element.Document)
    titles.append(element.Document.Title)
    paths.append(element.Document.PathName)

if isinstance(IN[0], (list)): OUT = docs,titles,paths
else: OUT = docs[0],titles[0],paths[0]
# ----------------------------------------
code_block = CodeBlock(x=python_script) { x[0]; x[1]; x[2]; }
Document = Output(code_block.out0)
Filename = Output(code_block.out1)
PathName = Output(code_block.out2)
