# Dynamo custom node Export DWFx from document.dyf (Dynamo 1.3.3.4651)
# category: GeniusLoci.Export
# Export Views to DWFx file from document

DirectoryPath = Input()
Filename = Input(Filename : string)
Views = Input()
MergeViews = Input(MergeViews : bool = true)
ObjectData = Input(ObjectData : bool = true)
Document = Input()
export_dwf = Python(IN[0]=DirectoryPath, IN[1]=Filename, IN[2]=Views, IN[3]=MergeViews, IN[4]=ObjectData, IN[5]=Document)
# ---------- export_dwf.python (37 lines) ----------
#Inspired by Node Export to FBX
#From mostafa el ayoubi, 2016 elayoub.mostafa@gmail.com

import clr
clr.AddReference('RevitAPI')
from Autodesk.Revit.DB import*
clr.AddReference('RevitServices')
from RevitServices.Persistence import DocumentManager
from RevitServices.Transactions import TransactionManager

doc = IN[5]

t = Transaction(doc,'export')
t.Start()

def tolist(input):
	if isinstance(input,list):
		return input
	else:
		return [input]

folder = IN[0]
prefix = IN[1]
views = tolist(IN[2])
result = []
vset = ViewSet()

for v in views:

    vset.Insert(UnwrapElement(v))
options = DWFXExportOptions()
options.MergedViews = IN[3]
options.ExportObjectData = IN[4]
result.append(doc.Export(folder,prefix,vset,options))

t.Commit()
OUT = 'Success' 
# ----------------------------------------
Succeed = Output(export_dwf)
