# Dynamo custom node Export DWFx in Document.dyf (Dynamo 1.3.4.6666)
# category: GeniusLoci.DWF
# Export Views to DWFx file in the active or given document.

document = Input(document : var[]..[] = null)  # Use only if you want to query other document
DirectoryPath = Input()
views = Input()
Filename = Input(Filename : string)
MergeViews = Input(MergeViews : bool = true)
ObjectData = Input(ObjectData : bool = true)
RunIt = Input(RunIt : bool = false)
export_dwf = Python(IN[0]=document, IN[1]=DirectoryPath, IN[2]=views, IN[3]=Filename, IN[4]=MergeViews, IN[5]=ObjectData, IN[6]=RunIt)
# ---------- export_dwf.python (72 lines) ----------
# Copyright(c) 2016, Konrad K Sobon
# @arch_laboratory, http://archi-lab.net

# Import Element wrapper extension methods
import clr
# Import DocumentManager and TransactionManager
clr.AddReference("RevitServices")
import RevitServices
from RevitServices.Persistence import DocumentManager
from RevitServices.Transactions import TransactionManager

# Import RevitAPI
clr.AddReference("RevitAPI")
import Autodesk
from Autodesk.Revit.DB import *

import sys
pyt_path = r'C:\Program Files (x86)\IronPython 2.7\Lib'
sys.path.append(pyt_path)

def tolist(obj1):
    if hasattr(obj1,"__iter__"): return obj1
    else: return [obj1]
    
inputdoc = tolist(UnwrapElement(IN[0]))
#Inputdoc : Part of script by Andreas Dieckmann
if inputdoc[0] == None:
	doc = DocumentManager.Instance.CurrentDBDocument
elif inputdoc[0].GetType().ToString() == "Autodesk.Revit.DB.Document":
	doc = inputdoc[0]
else: doc = DocumentManager.Instance.CurrentDBDocument

folder = IN[1]

views = tolist(UnwrapElement(IN[2]))

names = IN[3]

RunIt = IN[6]

TransactionManager.Instance.ForceCloseTransaction()
t = Transaction(doc,'export')
t.Start()

if RunIt:
	try:
		errorReport = None
		# run export
		options = DWFXExportOptions()
		vset = ViewSet()
		for view in views:
			vset.Insert(view)
		options.MergedViews = IN[4]
		options.ExportObjectData = IN[5]
		options.StopOnError = False
		result = doc.Export(folder, names, vset, options)
		
	except:
		# if error accurs anywhere in the process catch it
		import traceback
		errorReport = traceback.format_exc()
		
else:
	errorReport = "Please set the RunIt to True!"

t.Commit()

#Assign your output to the OUT variable
if errorReport == None:
	OUT = "Success"
else:
	OUT = errorReport
# ----------------------------------------
Result = Output(export_dwf)
