# Dynamo custom node Family Get SubCategory.dyf (Dynamo 1.3.4.6666)
# category: GeniusLoci.Family
# Retrieves the subcategories for a given family or family instance or family document.

FamilyOrFamilyInstanceOrFamilyDoc = Input()
family_get_subcategory = Python(IN[0]=FamilyOrFamilyInstanceOrFamilyDoc)
# ---------- family_get_subcategory.python (49 lines) ----------
#Alban de Chasteigner 2019
#twitter : @geniusloci_bim
#geniusloci.bim@gmail.com

import clr
clr.AddReference("RevitAPI")
import Autodesk
from Autodesk.Revit.DB import *

clr.AddReference("RevitNodes")
import Revit
clr.ImportExtensions(Revit.Elements)

clr.AddReference("RevitServices")
import RevitServices
from RevitServices.Persistence import DocumentManager
from RevitServices.Transactions import TransactionManager
doc = DocumentManager.Instance.CurrentDBDocument

families = UnwrapElement(IN[0]) if isinstance(IN[0],list) else [UnwrapElement(IN[0])]
fCat,subCategory = [],[]

TransactionManager.Instance.ForceCloseTransaction()
for fam in families:
	if isinstance(fam,FamilyInstance):
		family=fam.Symbol.Family
		famDoc = doc.EditFamily(family)
		cate=Revit.Elements.Category.ById((family.FamilyCategoryId).IntegerValue)
	elif isinstance(fam,Family):
		if fam.IsInPlace ==False:
			family=fam
		famDoc = doc.EditFamily(family)
		cate=Revit.Elements.Category.ById((family.FamilyCategoryId).IntegerValue)
	elif isinstance(fam,Document):
		famDoc = fam
		cate=Revit.Elements.Category.ById((famDoc.OwnerFamily.FamilyCategoryId).IntegerValue)
	else: pass	
	category = famDoc.OwnerFamily.FamilyCategory
	subcat=category.SubCategories
	for i in subcat:
		try:
			subCategory.append(Revit.Elements.Category.ById(i.Id.IntegerValue))
		except:subCategory.append(None)
	fCat.append(cate)
	if not isinstance(fam,Document):
		famDoc.Close(False)
	
if isinstance(IN[0], list): OUT = fCat,subCategory
else: OUT = fCat[0],subCategory
# ----------------------------------------
code_block = CodeBlock(x=family_get_subcategory) { x[0]; x[1]; }
Category = Output(code_block.out0)
SubCategory = Output(code_block.out1)
