# Dynamo custom node FamilyInstance Reference ByRefName.dyf (Dynamo 1.3.4.6666)
# category: GeniusLoci.Reference
# Works only in Revit 2018.1 and later.
# Gets the reference corresponding to the named reference plane in the instance's family.

familyInstance = Input()
name = Input(name : string="Center (Left/Right)")  # Reference Plane Name
python_script = Python(IN[0]=familyInstance, IN[1]=name)
# ---------- python_script.python (12 lines) ----------
import clr

elements = UnwrapElement(IN[0]) if isinstance(IN[0],list) else [UnwrapElement(IN[0])]
names = IN[1] if isinstance(IN[1],list) else [IN[1]]	
references = []

for elem in elements:
	for name in names:
		references.append(elem.GetReferenceByName(name))

if not isinstance(IN[0], list) and not isinstance(IN[1], list): OUT = references[0]
else: OUT = references
# ----------------------------------------
Reference = Output(python_script)
