# Dynamo custom node FamilyInstance Reference ByRefPlane.dyf (Dynamo 1.3.4.6666)
# category: GeniusLoci.Reference
# Works only in Revit 2018.1 and later.
# Gets family instance references corresponding to the reference planes in the instance's family.

familyInstance = Input()
ReferenceType = Input(ReferenceType=null)  # Default = Center (Left/Right)
python_script = Python(IN[0]=familyInstance, IN[1]=ReferenceType)
# ---------- python_script.python (32 lines) ----------
import clr
clr.AddReference('RevitServices')
import RevitServices
from RevitServices.Persistence import DocumentManager
from RevitServices.Transactions import TransactionManager
doc = DocumentManager.Instance.CurrentDBDocument

clr.AddReference('RevitAPI')
import Autodesk
from Autodesk.Revit.DB import *

elements = UnwrapElement(IN[0]) if isinstance(IN[0],list) else [UnwrapElement(IN[0])]
reftype = UnwrapElement(IN[1])
ref,refname,sketch=[],[],[]

TransactionManager.Instance.EnsureInTransaction(doc)
#Get Reference Planes from Families
for element in elements:
	if reftype == None:
		reference = element.GetReferences(FamilyInstanceReferenceType.CenterLeftRight)
	else :
		reference = element.GetReferences(reftype)
	ref.append(reference[0])
	refname.append(element.GetReferenceName(reference[0]))
	try :
		sketch.append(SketchPlane.Create(doc,reference[0]))
	except :
		sketch.append(None)
TransactionManager.Instance.TransactionTaskDone()

if isinstance(IN[0], list): OUT = ref,refname,sketch
else: OUT = ref[0],refname[0],sketch[0]
# ----------------------------------------
code_block = CodeBlock(x=python_script) { x[0]; x[1]; x[2]; }
Reference = Output(code_block.out0)
ReferenceName = Output(code_block.out1)
SketchPlane = Output(code_block.out2)
