# Dynamo custom node Get 3D views from document.dyf (Dynamo 1.3.3.4651)
# category: GeniusLoci.View
# Get 3D views in a given document

document = Input()
python_script = Python(IN[0]=document)
# ---------- python_script.python (48 lines) ----------
#Copyright(c) 2015, Konrad Sobon
# @arch_laboratory, http://archi-lab.net

import clr
clr.AddReference('ProtoGeometry')
from Autodesk.DesignScript.Geometry import *

# Import DocumentManager and TransactionManager
clr.AddReference("RevitServices")
import RevitServices
from RevitServices.Persistence import DocumentManager
from RevitServices.Transactions import TransactionManager

# Import RevitAPI
clr.AddReference("RevitAPI")
import Autodesk
from Autodesk.Revit.DB import *

from System.Collections.Generic import *

# Import ToDSType(bool) extension method
clr.AddReference("RevitNodes")
import Revit
clr.ImportExtensions(Revit.Elements)

#The inputs to this node will be stored as a list in the IN variable.

def tolist(x):
	if hasattr(x,'__iter__'): return x
	else : return [x]
docs = tolist(IN[0])

#collect all views in the model
for doc in docs:
	collector = FilteredElementCollector(doc)
	views = collector.OfClass(View).ToElements()

#sort views into separate lists based on view type
threeD = []
for i in views:
	if not i.IsTemplate:
		if i.ViewType == ViewType.ThreeD:
			threeD.append(i.ToDSType(True))
		else:
			continue

#Assign your output to the OUT variable
OUT = threeD
# ----------------------------------------
n3D_views = Output(python_script)  # "3D views"
