# Dynamo custom node Get DWG Export Setup.dyf (Dynamo 1.3.4.6666)
# category: GeniusLoci.CAD Export
# Collect the DWGExportOptions stored in the ExportDwgSettings.

ExportDwgSettings = Input()
getDWGExportOptions = Python(IN[0]=ExportDwgSettings)
# ---------- getDWGExportOptions.python (28 lines) ----------
#Alban de Chasteigner 2018
#twitter : @geniusloci_bim
#geniusloci.bim@gmail.com

import clr
clr.AddReference('RevitAPI')
from Autodesk.Revit.DB import *

clr.AddReference("RevitNodes")
import Revit
clr.ImportExtensions(Revit.Elements)

clr.AddReference("RevitServices")
import RevitServices
from RevitServices.Persistence import DocumentManager

doc = DocumentManager.Instance.CurrentDBDocument

settings = UnwrapElement(IN[0])
if not hasattr(settings, '__iter__'):
    settings = [settings]

exportSettings = []
for i in settings:
	option = i.GetDWGExportOptions()
	exportSettings.append(option)

OUT = exportSettings
# ----------------------------------------
DWGExportOptions = Output(getDWGExportOptions)
