# Dynamo custom node Get Element Color Overrides.dyf (Dynamo 1.3.4.6666)
# category: GeniusLoci.Graphics
# Retrieves the color of the element with several methods (view-specific, view filter and material overrides).

element = Input()
view = Input(view:var[]..[] = Revit.Application.Document.Current.ActiveView)
get_color_override = Python(IN[0]=element, IN[1]=view)
# ---------- get_color_override.python (77 lines) ----------
#Based on a Lukas Mikkelsen's script
import clr
clr.AddReference('DSCoreNodes')
import DSCore
from DSCore import Color

#Import ToDSType(bool) extension method
clr.AddReference("RevitNodes")
import Revit
clr.ImportExtensions(Revit.Elements)

# Import DocumentManager and TransactionManager
clr.AddReference("RevitServices")
import RevitServices
from RevitServices.Persistence import DocumentManager

# Import RevitAPI
clr.AddReference("RevitAPI")
import Autodesk
from Autodesk.Revit.DB import *

doc = DocumentManager.Instance.CurrentDBDocument
uiapp = DocumentManager.Instance.CurrentUIApplication
app = uiapp.Application

def tolist(obj1):
	if hasattr(obj1,"__iter__"): return obj1
	else: return [obj1]

elements = tolist(UnwrapElement(IN[0]))
views = tolist(UnwrapElement(IN[1]))[0]

output = []

for element in elements :
	#activeview = doc.ActiveView
	override = views.GetElementOverrides(element.Id)
	color = None
	if override.ProjectionFillColor.IsValid:
		color = DSCore.Color.ByARGB(255, override.ProjectionFillColor.Red, override.ProjectionFillColor.Green, override.ProjectionFillColor.Blue)
	else:
		filters = views.GetFilters() # Get all the filter ids
		for f in filters:
			filtercats = [x for x in doc.GetElement(f).GetCategories()]
			# Check if element category corresponds to filter category
			if element.Category.Id in filtercats:
			 	filterrules = doc.GetElement(f).GetRules()
			 	rulepassed = []
			 	# Check if element passes all filter rules
			 	for frule in filterrules:
			 		rulepassed.append(frule.ElementPasses(element))
			 	if all(rulepassed):
		 			override = views.GetFilterOverrides(f)
					# BEWARE: THIS PART ASSUMES THAT MULTIPLE FILTERS DOES NOT COLLIDE IN REGARDS TO COLOR DEFINITION OF THE ELEMENT
		 			if override.ProjectionFillColor.IsValid:
						color = DSCore.Color.ByARGB(255, override.ProjectionFillColor.Red, override.ProjectionFillColor.Green, override.ProjectionFillColor.Blue)
			 		else:
			 			pass
			 	# Otherwise element does not satisfy the filter
			 	else:
			 		pass
			# Otherwise the element category does not correspond to the filter category
			else:
				pass
		# Check if color has been previously defined.
		# If the color is retrieved based on material, our element may consist of multiple materials.
		if not color:
			color = []
			mats = [doc.GetElement(x) for x in element.GetMaterialIds(False)]
			for mat in mats:
				color.append(DSCore.Color.ByARGB(255, mat.Color.Red, mat.Color.Green, mat.Color.Blue))
		else:
			pass
	output.append(color)
#Assign your output to the OUT variable
if isinstance(IN[0], list): OUT = output
else: OUT = output[0]
# ----------------------------------------
Color = Output(get_color_override)
