# Dynamo custom node Get Element Worksharing Tooltip Info.dyf (Dynamo 1.3.4.6666)
# category: GeniusLoci.Element
# Returns worksharing informations (Creator, LastChangedBy, Owner) about element in the given document.

elements = Input()
docOrRevitLinkInstance = Input(docOrRevitLinkInstance : var = null)  # Use only if you want to query a linked model
getWorksharingTooltipInfo = Python(IN[0]=elements, IN[1]=docOrRevitLinkInstance)
# ---------- getWorksharingTooltipInfo.python (34 lines) ----------
import clr

clr.AddReference("RevitServices")
import RevitServices
from RevitServices.Persistence import DocumentManager

clr.AddReference("RevitAPI")
from Autodesk.Revit.DB import *

elements = UnwrapElement(IN[0])
if not hasattr(elements, '__iter__'):
	elements = [elements]

#Part of script from Clockwork
inputdoc = UnwrapElement(IN[1])
if inputdoc == None:
	doc = DocumentManager.Instance.CurrentDBDocument
elif inputdoc.GetType().ToString() == "Autodesk.Revit.DB.RevitLinkInstance":
	doc = inputdoc.GetLinkDocument()
elif inputdoc.GetType().ToString() == "Autodesk.Revit.DB.Document":
	doc = inputdoc
else: doc = None

creator = []
changer = []
owner = []

for element in elements:	
	tooltip = WorksharingUtils.GetWorksharingTooltipInfo(doc, element.Id)
	creator.append(tooltip.Creator)
	changer.append(tooltip.LastChangedBy)
	owner.append(tooltip.Owner)

OUT = creator, changer, owner
# ----------------------------------------
code_block = CodeBlock(x=getWorksharingTooltipInfo) { x[0]; x[1]; x[2]; }
Creator = Output(code_block.out0)
LastChangedBy = Output(code_block.out1)
Owner = Output(code_block.out2)
