# Dynamo custom node Get Elements Overrides.dyf (Dynamo 1.3.4.6666)
# category: GeniusLoci.Graphics
# Note: This method is deprecated in Revit 2019.
# Get the overrides applied to the elements in the given View.

element = Input()
view = Input(view:var[]..[] = Revit.Application.Document.Current.ActiveView)
python_script = Python(IN[0]=element, IN[1]=view)
# ---------- python_script.python (61 lines) ----------
#Alban de Chasteigner 2018
#twitter : @geniusloci_bim
#geniusloci.bim@gmail.com

import clr
clr.AddReference('RevitAPI')
from Autodesk.Revit.DB import *

# Import DocumentManager and TransactionManager
clr.AddReference('RevitServices')
import RevitServices
from RevitServices.Persistence import DocumentManager
doc = DocumentManager.Instance.CurrentDBDocument

clr.AddReference('DSCoreNodes')
import DSCore
from DSCore import Color

elements = UnwrapElement(IN[0])
if not hasattr(elements, '__iter__'):
	elements = [elements]
	
view = UnwrapElement(IN[1])

listprwe,listprojRGB,listprPat,listprojfillRGB,listprFiPat,listcutwe,listcutRGB,listcutPat,listcutfillRGB,listcutFiPat,listtrans,listhalf = [],[],[],[],[],[],[],[],[],[],[],[]

for element in elements:
	o = view.GetElementOverrides(element.Id)
	projCol = o.ProjectionLineColor
	if projCol.IsValid:
		projrgb = DSCore.Color.ByARGB(255, projCol.Red, projCol.Green, projCol.Blue)
	else:
		projrgb = None
	listprojRGB.Add(projrgb)
	projFillCol=o.ProjectionFillColor
	if projFillCol.IsValid:
		projfillrgb = DSCore.Color.ByARGB(255, projFillCol.Red, projFillCol.Green, projFillCol.Blue)
	else:
		projfillrgb = None
	listprojfillRGB.Add(projfillrgb)
	cutCol= o.CutLineColor
	if cutCol.IsValid:
		cutrgb = DSCore.Color.ByARGB(255, cutCol.Red, cutCol.Green, cutCol.Blue)
	else:
		cutrgb = None
	listcutRGB.Add(cutrgb)
	cutfillcolor=o.CutFillColor
	if cutfillcolor.IsValid:
		cutfillrgb = DSCore.Color.ByARGB(255, cutfillcolor.Red, cutfillcolor.Green, cutfillcolor.Blue)
	else:
		cutfillrgb = None
	listcutfillRGB.Add(cutfillrgb)
	listtrans.append(o.Transparency)
	listhalf.append(o.Halftone)
	listprwe.append(o.ProjectionLineWeight)
	listprPat.append(doc.GetElement(o.ProjectionLinePatternId))
	listprFiPat.append(doc.GetElement(o.ProjectionFillPatternId))
	listcutwe.append(o.CutLineWeight)
	listcutPat.append(doc.GetElement(o.CutLinePatternId))
	listcutFiPat.append(doc.GetElement(o.CutFillPatternId))
OUT=listprwe,listprojRGB,listprPat,listprojfillRGB,listprFiPat,listcutwe,listcutRGB,listcutPat,listcutfillRGB,listcutFiPat,listtrans,listhalf
# ----------------------------------------
code_block = CodeBlock(x=python_script) { x[0]; x[1]; x[2]; x[3]; x[4]; x[5]; x[6]; x[7]; x[8]; x[9]; x[10]; x[11]; }
ProjectionLineWeight = Output(code_block.out0)
ProjectionLineColor = Output(code_block.out1)
ProjectionLinePattern = Output(code_block.out2)
SurfacePatternColor = Output(code_block.out3)
SurfacePattern = Output(code_block.out4)
CutLineWeight = Output(code_block.out5)
CutLineColor = Output(code_block.out6)
CutLinePattern = Output(code_block.out7)
CutPatternColor = Output(code_block.out8)
CutPattern = Output(code_block.out9)
Halftone = Output(code_block.out11)
Transparency = Output(code_block.out10)
