# Dynamo custom node Get Material Properties.dyf (Dynamo 1.3.4.6666)
# category: GeniusLoci.Material
# Note : This method is deprecated in Revit 2019.
# Get name, color, transparency, Surface and Cut patterns from the given material..

material = Input()
material_2 = Python(IN[0]=material)
# ---------- material_2.python (54 lines) ----------
#Alban de Chasteigner 2018

import clr
clr.AddReference("RevitAPI")
from Autodesk.Revit.DB import *
clr.AddReference("RevitServices")
import RevitServices
from RevitServices.Persistence import DocumentManager
from RevitServices.Transactions import TransactionManager
clr.AddReference("RevitNodes")
import Revit
clr.ImportExtensions(Revit.Elements)
clr.AddReference('DSCoreNodes')
import DSCore
from DSCore import Color

doc = DocumentManager.Instance.CurrentDBDocument

def tolist(obj1):
	if hasattr(obj1,"__iter__"): return obj1
	else: return [obj1]

materials = tolist(UnwrapElement(IN[0]))
colorname=[]
colorlist=[]
spatternlist=[]
surcolorlist = []
cpatternlist=[]
cutcolorlist=[]
transparencylist=[]
rgbList=[]
rgbSList=[]
rgbCList=[]

for material in materials :
	colorname.append(material.Name)
	colorlist.append(material.Color)
	spatternlist.append(doc.GetElement(material.SurfacePatternId))
	surcolorlist.append(material.SurfacePatternColor)
	cpatternlist.append(doc.GetElement(material.CutPatternId))
	cutcolorlist.append(material.CutPatternColor)
	transparencylist.append(material.Transparency)
	for colors in colorlist :
		rgb = DSCore.Color.ByARGB(255, colors.Red, colors.Green, colors.Blue)
	rgbList.Add(rgb)
	for surcolor in surcolorlist :
		rgbS = DSCore.Color.ByARGB(255, surcolor.Red, surcolor.Green, surcolor.Blue)
	rgbSList.Add(rgbS)
	for cutcolor in cutcolorlist :
		rgbC = DSCore.Color.ByARGB(255, cutcolor.Red, cutcolor.Green, cutcolor.Blue)
	rgbCList.Add(rgbC)


OUT = colorname,rgbList,spatternlist,rgbSList,cpatternlist,rgbCList,transparencylist
# ----------------------------------------
code_block = CodeBlock(x=material_2) { x[0]; x[1]; x[2]; x[3]; x[4]; x[5]; x[6]; }
Material_Name = Output(code_block.out0)
Material_Color = Output(code_block.out1)
SurfacePattern = Output(code_block.out2)
SurfacePatternColor = Output(code_block.out3)
CutPattern = Output(code_block.out4)
CutPatternColor = Output(code_block.out5)
Material_Transparency = Output(code_block.out6)
