# Dynamo custom node Get View By Type.dyf (Dynamo 1.3.4.6666)
# category: GeniusLoci.View
# Gets all views by type.
# For the View Template Type, the 3D View Templates will not be retrieved.

viewType = Input(viewType:string[]..[])  # For use with the View Type node
docOrRevitLinkInstance = Input(docOrRevitLinkInstance : var[]..[] = null)  # Use only to query a linked model
python_script = Python(IN[0]=viewType, IN[1]=docOrRevitLinkInstance)
# ---------- python_script.python (39 lines) ----------
import clr
clr.AddReference('RevitAPI')
import Autodesk
from Autodesk.Revit.DB import *

clr.AddReference('RevitServices')
import RevitServices
from RevitServices.Persistence import DocumentManager

import System

viewType = IN[0]
inputdocs = UnwrapElement(IN[1]) if isinstance(IN[1],list) else [UnwrapElement(IN[1])]

#Part of script from Clockwork
for inputdoc in inputdocs :
	if inputdoc == None:
		doc = DocumentManager.Instance.CurrentDBDocument
	elif inputdoc.GetType().ToString() == "Autodesk.Revit.DB.Document":
		doc = inputdoc
	elif inputdoc.GetType().ToString() == "Autodesk.Revit.DB.RevitLinkInstance":
		doc = inputdoc.GetLinkDocument()
	else: doc = DocumentManager.Instance.CurrentDBDocument

viewList=[]
colViews = FilteredElementCollector(doc).OfClass(View).ToElements()

if viewType != "View Template":
	vType  = System.Enum.Parse(Autodesk.Revit.DB.ViewType, IN[0])
	for i in colViews:
		if i.ViewType == vType and not i.IsTemplate:
			viewList.Add(i)

elif viewType == "View Template":
	for i in colViews:
		if i.ViewType != ViewType.ThreeD and i.IsTemplate:
			viewList.Add(i)

OUT=viewList
# ----------------------------------------
Views = Output(python_script)
