# Dynamo custom node Group Parallel Lines.dyf (Dynamo 1.3.4.6666)
# category: GeniusLoci.Geometry
# Groups parallel lines or curved elements (model and detail lines) together.

lines = Input()  # Dynamo line or straight curved elements (such as Model or Detail Line)
python_script = Python(IN[0]=lines)
# ---------- python_script.python (42 lines) ----------
#Strongly inspired by Maciek Glowka http://lubim.co

import clr
# Import RevitAPI Classes
clr.AddReference('RevitAPI')
import Autodesk
from Autodesk.Revit.DB import *

# Import ToDSType extension method
clr.AddReference("RevitNodes")
import Revit
clr.ImportExtensions(Revit.GeometryConversion)

def isParallel(v1,v2):
  return v1.CrossProduct(v2).IsAlmostEqualTo(XYZ(0,0,0))
  
lineElements = UnwrapElement(IN[0])

directions = []
lines_groups = []
#group parallel lines together
for lineElement in lineElements:
	if hasattr(lineElement, "Explode"):
		l=lineElement.ToRevitType()
	else:
		l = lineElement.GeometryCurve
	d = l.GetEndPoint(1)-l.GetEndPoint(0)
	idx = -1
	for i in range(len(directions)):
		if isParallel(d,directions[i]):
			idx = i
			break
    
	if idx!=-1:
		lines_groups[idx].append(lineElement)
	else:
		directions.append(d)
		new_group = []
		new_group.append(lineElement)
		lines_groups.append(new_group)
      
OUT = lines_groups
# ----------------------------------------
Grouped_Lines = Output(python_script)
