# Dynamo custom node Material Find Texture Path.dyf (Dynamo 1.3.4.6666)
# category: GeniusLoci.Material
# Works only in Revit 2018.1 and later.
# Find the texture paths of the materials.

material = Input()
python_script = Python(IN[0]=material)
# ---------- python_script.python (38 lines) ----------
#Alban de Chasteigner 2020
#twitter : @geniusloci_bim
#geniusloci.bim@gmail.com

import clr
clr.AddReference('RevitAPI')
import Autodesk
from Autodesk.Revit.DB import *

clr.AddReference('RevitServices')
import RevitServices
from RevitServices.Persistence import DocumentManager

doc = DocumentManager.Instance.CurrentDBDocument

mats = UnwrapElement(IN[0]) if isinstance(IN[0],list) else [UnwrapElement(IN[0])]
path,propertyName,library=[],[],[]

for mat in mats:
	assetElem = doc.GetElement(mat.AppearanceAssetId)
	if assetElem:
		with Visual.AppearanceAssetEditScope(doc) as editScope:
			asset = editScope.Start(assetElem.Id)
			for idx in range(0, asset.Size):
			#idx=0
			#while idx < asset.Size:
				property=asset.Get(idx)
				#if property.NumberOfConnectedProperties < 1 :
				connectedAsset=property.GetSingleConnectedAsset()
				if connectedAsset:
					if connectedAsset.Name == "UnifiedBitmapSchema":
						#path.append(connectedAsset["unifiedbitmap_Bitmap"].Value)
						path.append(connectedAsset.FindByName("unifiedbitmap_Bitmap").Value)
						#propertyName.append(property.Name) 
						#library.append(connectedAsset.LibraryName)
				#idx += 1

OUT=filter(None,path)
# ----------------------------------------
FilePath = Output(python_script)
