# Dynamo custom node New Create Material.dyf (Dynamo 1.3.4.6666)
# category: GeniusLoci.Material
# Works only in Revit 2019 and later.
# Create new materials or overwrite properties of existing materials.
# Use nulls as input to create the material without its properties (Transparency, SurfacePattern ...)

Name = Input(Name:string[]..[])
color = Input(color:var[]..[]= DSCore.Color.ByARGB(255,255,255,255))  # Dynamo Color
SurfaceForegroundPattern = Input(SurfaceForegroundPattern:var[]..[]="<Solid fill>")  # Pattern as String or FillPatternElement
SurfacePatternTarget = Input(SurfacePatternTarget:var[]..[]="Drafting")  # String = Drafting or Model
SurfaceForegroundPatternColor = Input(SurfaceForegroundPatternColor:var[]..[] = DSCore.Color.ByARGB(255,255,255,255))  # Dynamo Color
CutForegroundPattern = Input(CutForegroundPattern:var[]..[]="<Solid fill>")  # Pattern as String or FillPatternElement
CutForegroundPatternColor = Input(CutForegroundPatternColor:var[]..[] = DSCore.Color.ByARGB(255,255,255,255))  # Dynamo Color
Transparency = Input(Transparency:var[]..[]=0)  # Integer
create_material = Python(IN[0]=Name, IN[1]=color, IN[2]=SurfaceForegroundPattern, IN[3]=SurfacePatternTarget, IN[4]=SurfaceForegroundPatternColor, IN[5]=CutForegroundPattern, IN[6]=CutForegroundPatternColor, IN[7]=Transparency)
# ---------- create_material.python (130 lines) ----------
# by GregX, David Dória, archilab and Alban de Chasteigner
import clr
clr.AddReference('RevitAPI')
from Autodesk.Revit.DB import *
clr.AddReference('RevitServices')
import RevitServices
from RevitServices.Persistence import DocumentManager
from RevitServices.Transactions import TransactionManager
doc = DocumentManager.Instance.CurrentDBDocument

def toList(obj):
    if hasattr(obj, '__iter__'): return obj
    else: return [obj]

names = toList(IN[0])
colors = toList(IN[1])
surfPat = toList(UnwrapElement(IN[2]))
targets = toList(IN[3])
surfPatCl = toList(IN[4])
cutPat = toList(UnwrapElement(IN[5]))
cutPatCl = toList(IN[6])
transparency = toList(IN[7])
fillPatTargets=[]

for target in targets :
	if target == "Drafting":
		fillPatTarget = FillPatternTarget.Drafting
	else:
		fillPatTarget = FillPatternTarget.Model
	fillPatTargets.append(fillPatTarget)

#New materials OUT list
newMaterials = []
#Overwritten materials OUT list
#ovwMaterials = []

def ToRevitColor(dynamoColor):
	return Color(dynamoColor.Red, dynamoColor.Green, dynamoColor.Blue)

#Iterate through the input names list
for n, cl, sp, tar, spC, cp, cpC, trans in zip(names,colors,surfPat,fillPatTargets,surfPatCl,cutPat,cutPatCl,transparency):
	#Check if the material with the specified name already exists
	if Material.IsNameUnique(doc,n):
		#If name is unique, create material
		TransactionManager.Instance.EnsureInTransaction(doc)
		new_mat_id = Material.Create(doc, n)
		new_mat = doc.GetElement(new_mat_id)
		if sp != None and target == None:
			tar = FillPatternTarget.Drafting
		if sp == None:
			pass
		else:
			if sp.GetType().ToString()	== "System.String" :
				new_mat.SurfaceForegroundPatternId = FillPatternElement.GetFillPatternElementByName(doc,tar,sp).Id
			else:
				new_mat.SurfaceForegroundPatternId = sp.Id
		if spC == None:
			pass
		else:
			new_mat.SurfaceForegroundPatternColor = ToRevitColor(spC)
		if cp == None:
			pass
		else:
			if cp.GetType().ToString()	== "System.String" :
				new_mat.CutForegroundPatternId = FillPatternElement.GetFillPatternElementByName(doc, FillPatternTarget.Drafting,cp).Id
			else:
				new_mat.CutForegroundPatternId = cp.Id
		if cpC == None:
			pass
		else:
			new_mat.CutForegroundPatternColor = ToRevitColor(cpC)
		if cl == None:
			pass
		else:
			new_mat.Color = ToRevitColor(cl)
		if trans == None:
			pass
		else:	
			new_mat.Transparency = trans

		TransactionManager.Instance.TransactionTaskDone()
		newMaterials.append(new_mat)
	else:
		#If it already exists, collect it and modify it
		TransactionManager.Instance.EnsureInTransaction(doc)
		namePar = ParameterValueProvider(ElementId(BuiltInParameter.MATERIAL_NAME))
		fRule = FilterStringRule(namePar,FilterStringEquals(),n, True)
		filter = ElementParameterFilter(fRule)
		exist_mat = FilteredElementCollector(doc).OfClass(Material).WherePasses(filter).ToElements()
		#Iteration is necessary because the output of exist_mat is invariably a list
		for em in exist_mat:
			#Modify the Material Properties and Parameters
			if sp != None and target == None:
				tar = FillPatternTarget.Drafting
			if sp == None:
				pass
			else:
				if sp.GetType().ToString()	== "System.String" :
					em.SurfaceForegroundPatternId = FillPatternElement.GetFillPatternElementByName(doc,tar,sp).Id
				else:
					em.SurfaceForegroundPatternId = sp.Id
			if spC == None:
				pass
			else:
				em.SurfaceForegroundPatternColor = ToRevitColor(spC)
			if cp == None:
				pass
			else:
				if cp.GetType().ToString()	== "System.String" :
					em.CutForegroundPatternId = FillPatternElement.GetFillPatternElementByName(doc, FillPatternTarget.Drafting,cp).Id
				else:
					em.CutForegroundPatternId = cp.Id
			if cpC == None:
				pass
			else:
				em.CutForegroundPatternColor = ToRevitColor(cpC)
			if cl == None:
				pass
			else:	
				em.Color = ToRevitColor(cl)
			if trans == None:
				pass
			else:	
				em.Transparency = trans
			
			newMaterials.append(em)
		TransactionManager.Instance.TransactionTaskDone()

if isinstance(IN[0], list): OUT = newMaterials
else: OUT = newMaterials[0]
# ----------------------------------------
Material = Output(create_material)
