# Dynamo custom node New Get Elements Overrides.dyf (Dynamo 1.3.4.6666)
# category: GeniusLoci.Graphics
# Works only in Revit 2019 and later.
# Get the overrides applied to the elements in the given View.

element = Input()
view = Input(view:var[]..[] = Revit.Application.Document.Current.ActiveView)
python_script = Python(IN[0]=element, IN[1]=view)
# ---------- python_script.python (80 lines) ----------
#Alban de Chasteigner 2018
#twitter : @geniusloci_bim
#geniusloci.bim@gmail.com

import clr
clr.AddReference('RevitAPI')
from Autodesk.Revit.DB import *

# Import DocumentManager and TransactionManager
clr.AddReference('RevitServices')
import RevitServices
from RevitServices.Persistence import DocumentManager
doc = DocumentManager.Instance.CurrentDBDocument

clr.AddReference('DSCoreNodes')
import DSCore
from DSCore import Color

elements = UnwrapElement(IN[0])
if not hasattr(elements, '__iter__'):
	elements = [elements]
	
view = UnwrapElement(IN[1])

listprwe,listprojRGB,listprPat,listSurForPatRGB,listSurForPat,listSurBacPatRGB,listSurBacPat,listcutwe,listcutRGB,listcutPat,listCutForPatRGB,listCutForPat,listCutBacPatRGB,listCutBacPat,listtrans,listhalf = [],[],[],[],[],[],[],[],[],[],[],[],[],[],[],[]

for element in elements:
	o = view.GetElementOverrides(element.Id)
	projCol = o.ProjectionLineColor
	if projCol.IsValid:
		projrgb = DSCore.Color.ByARGB(255, projCol.Red, projCol.Green, projCol.Blue)
	else:
		projrgb = None
	listprojRGB.Add(projrgb)
	
	projFillCol=o.SurfaceForegroundPatternColor
	if projFillCol.IsValid:
		projfillrgb = DSCore.Color.ByARGB(255, projFillCol.Red, projFillCol.Green, projFillCol.Blue)
	else:
		projfillrgb = None
	listSurForPatRGB.Add(projfillrgb)
	
	SurBacCol=o.SurfaceBackgroundPatternColor
	if SurBacCol.IsValid:
		SurBacrgb = DSCore.Color.ByARGB(255, SurBacCol.Red, SurBacCol.Green, SurBacCol.Blue)
	else:
		SurBacrgb = None
	listSurBacPatRGB.Add(SurBacrgb)
	
	cutCol= o.CutLineColor
	if cutCol.IsValid:
		cutrgb = DSCore.Color.ByARGB(255, cutCol.Red, cutCol.Green, cutCol.Blue)
	else:
		cutrgb = None
	listcutRGB.Add(cutrgb)
	
	cutfillcolor=o.CutForegroundPatternColor
	if cutfillcolor.IsValid:
		cutfillrgb = DSCore.Color.ByARGB(255, cutfillcolor.Red, cutfillcolor.Green, cutfillcolor.Blue)
	else:
		cutfillrgb = None
	listCutForPatRGB.Add(cutfillrgb)
	
	cutBaccolor=o.CutBackgroundPatternColor
	if cutBaccolor.IsValid:
		cutBacrgb = DSCore.Color.ByARGB(255, cutBaccolor.Red, cutBaccolor.Green, cutBaccolor.Blue)
	else:
		cutBacrgb = None
	listCutBacPatRGB.Add(cutBacrgb)
	listtrans.append(o.Transparency)
	listhalf.append(o.Halftone)
	listprwe.append(o.ProjectionLineWeight)
	listprPat.append(doc.GetElement(o.ProjectionLinePatternId))
	listSurForPat.append(doc.GetElement(o.SurfaceForegroundPatternId))
	listSurBacPat.append(doc.GetElement(o.SurfaceBackgroundPatternId))
	listcutwe.append(o.CutLineWeight)
	listcutPat.append(doc.GetElement(o.CutLinePatternId))
	listCutForPat.append(doc.GetElement(o.CutForegroundPatternId))
	listCutBacPat.append(doc.GetElement(o.CutBackgroundPatternId))
OUT=listprwe,listprojRGB,listprPat,listSurForPatRGB,listSurForPat,listSurBacPatRGB,listSurBacPat,listcutwe,listcutRGB,listcutPat,listCutForPatRGB,listCutForPat,listCutBacPatRGB,listCutBacPat,listtrans,listhalf
# ----------------------------------------
code_block = CodeBlock(x=python_script) { x[0]; x[1]; x[2]; x[3]; x[4]; x[5]; x[6]; x[7]; x[8]; x[9]; x[10]; x[11]; x[12]; x[13]; x[14]; x[15]; }
ProjectionLineWeight = Output(code_block.out0)
ProjectionLineColor = Output(code_block.out1)
ProjectionLinePattern = Output(code_block.out2)
SurfaceForegroundPatternColor = Output(code_block.out3)
SurfaceForegroundPattern = Output(code_block.out4)
SurfaceBackgroundPatternColor = Output(code_block.out5)
SurfaceBackgroundPattern = Output(code_block.out6)
CutLineWeight = Output(code_block.out7)
CutLineColor = Output(code_block.out8)
CutLinePattern = Output(code_block.out9)
CutForegroundPatternColor = Output(code_block.out10)
CutForegroundPattern = Output(code_block.out11)
CutBackgroundPatternColor = Output(code_block.out12)
CutBackgroundPattern = Output(code_block.out13)
Transparency = Output(code_block.out14)
Halftone = Output(code_block.out15)
