# Dynamo custom node Override Graphics in View.dyf (Dynamo 1.3.4.6666)
# category: GeniusLoci.Graphics
# Overrides element graphics settings in the given view.
# (All graphic inputs are optional)
# Note : Prior to Revit 2019, the materials have only one surface pattern and one cut pattern.

element = Input()
view = Input(view:var[]..[] = Revit.Application.Document.Current.ActiveView)
ProjectionLinePattern = Input(ProjectionLinePattern:var[]..[]=null)
ProjectionLineColor = Input(ProjectionLineColor:var[]..[]=null)  # Dynamo Color
ProjectionLineWeight = Input(ProjectionLineWeight:var[]..[]=null)  # Integer within the range 1-16
SurfaceForegroundPattern = Input(SurfaceForegroundPattern:var[]..[]=null)
SurfaceForegroundPatternColor = Input(SurfaceForegroundPatternColor:var[]..[] = null)  # Dynamo Color
SurfaceBackgroundPattern = Input(SurfaceBackgroundPattern:var[]..[]=null)
SurfaceBackgroundColor = Input(SurfaceBackgroundColor:var[]..[] = null)  # Dynamo Color
CutLinePattern = Input(CutLinePattern:var[]..[]=null)
CutLineColor = Input(CutLineColor:var[]..[]=null)  # Dynamo Color
CutLineWeight = Input(CutLineWeight:var[]..[]=null)  # Integer within the range 1-16
CutForegroundPattern = Input(CutForegroundPattern:var[]..[]=null)
CutForegroundPatternColor = Input(CutForegroundPatternColor:var[]..[] = null)  # Dynamo Color
CutBackgroundPattern = Input(CutBackgroundPattern:var[]..[]=null)
CutBackgroundPatternColor = Input(CutBackgroundPatternColor:var[]..[] = null)  # Dynamo Color
Transparency = Input(Transparency:var[]..[]=null)  # Integer
Halftone = Input(Halftone:var[]..[] = null)  # Boolean. True = halftone
python_script = Python(IN[0]=element, IN[1]=view, IN[2]=ProjectionLinePattern, IN[3]=ProjectionLineColor, IN[4]=ProjectionLineWeight, IN[5]=SurfaceForegroundPattern, IN[6]=SurfaceForegroundPatternColor, IN[7]=SurfaceBackgroundPattern, IN[8]=SurfaceBackgroundColor, IN[9]=CutLinePattern, IN[10]=CutLineColor, IN[11]=CutLineWeight, IN[12]=CutForegroundPattern, IN[13]=CutForegroundPatternColor, IN[14]=CutBackgroundPattern, IN[15]=CutBackgroundPatternColor, IN[16]=Transparency, IN[17]=Halftone)
# ---------- python_script.python (161 lines) ----------
import clr
#Import the Revit API
clr.AddReference('RevitAPI')
import Autodesk
from Autodesk.Revit.DB import *

#Import DocumentManager and TransactionManager
clr.AddReference('RevitServices')
import RevitServices
from RevitServices.Persistence import DocumentManager
from RevitServices.Transactions import TransactionManager
doc = DocumentManager.Instance.CurrentDBDocument
uiapp = DocumentManager.Instance.CurrentUIApplication
app = uiapp.Application
version=int(app.VersionNumber)

def tolist(obj1):
	if hasattr(obj1,"__iter__"): return obj1
	else: return [obj1]
	
def ConvertColor(e):
	return Autodesk.Revit.DB.Color(e.Red, e.Green, e.Blue)

elems = tolist(UnwrapElement(IN[0]))
views = tolist(UnwrapElement(IN[1]))
projLinePats = tolist(UnwrapElement(IN[2]))
projLineColors = tolist(IN[3])
projLineWeights = tolist(IN[4])
surfaceForePats = tolist(UnwrapElement(IN[5]))
surfaceForePatcolors = tolist(IN[6])
surfaceBackPats = tolist(UnwrapElement(IN[7]))
surfaceBackPatcolors = tolist(IN[8])
cutLinePats = tolist(UnwrapElement(IN[9]))
cutLineColors = tolist(IN[10])
cutLineWeights = tolist(IN[11])
cutForePats = tolist(UnwrapElement(IN[12]))
cutForePatcolors = tolist(IN[13])
cutBackPats = tolist(UnwrapElement(IN[14]))
cutBackPatcolors = tolist(IN[15])
transparencies = tolist(IN[16])
halftones = tolist(IN[17])
output = []

for projLinePat, projLineColor,projLineWeight,surfaceForePat,surfaceForePatcolor, surfaceBackPat, surfaceBackPatcolor, cutLinePat, cutLineColor,cutLineWeight,cutForePat, cutForePatcolor,cutBackPat, cutBackPatcolor,transparency,halftone in zip(projLinePats, projLineColors,projLineWeights, surfaceForePats,surfaceForePatcolors, surfaceBackPats, surfaceBackPatcolors, cutLinePats, cutLineColors,cutLineWeights,cutForePats, cutForePatcolors,cutBackPats, cutBackPatcolors,transparencies,halftones):
	#Create the OverridesGraphicsSettings
	ogs = OverrideGraphicSettings()
	if projLinePat == None:
		pass
	else:
		ogs.SetProjectionLinePatternId(projLinePat.Id)
	if projLineColor == None:
		pass
	else:
		ogs.SetProjectionLineColor(ConvertColor(projLineColor))
	if projLineWeight == None:
		pass
	else:
		ogs.SetProjectionLineWeight(projLineWeight)
	if cutLinePat == None:
		pass
	else:
		ogs.SetCutLinePatternId(cutLinePat.Id)
	if cutLineColor == None:
		pass
	else:
		ogs.SetCutLineColor(ConvertColor(cutLineColor))
	if cutLineWeight == None:
		pass
	else:
		ogs.SetCutLineWeight(cutLineWeight)
	if transparency == None:
		pass
	else:
		ogs.SetSurfaceTransparency(transparency)
	if halftone == None:
		pass
	else:
		ogs.SetHalftone(halftone)
	if version < 2019 :
		if surfaceForePatcolor == None:
			pass
		else:
			ogs.SetProjectionFillColor(ConvertColor(surfaceForePatcolor))
		if surfaceForePat == None:
			pass
		else:
			ogs.SetProjectionFillPatternId(surfaceForePat.Id)
			ogs.SetProjectionFillPatternVisible(True)
		if surfaceBackPatcolor == None:
			pass
		else:
			ogs.SetProjectionFillColor(ConvertColor(surfaceBackPatcolor))
		if surfaceBackPat == None:
			pass
		else:
			ogs.SetProjectionFillPatternId(surfaceBackPat.Id)
			ogs.SetProjectionFillPatternVisible(True)
		if cutForePatcolor == None:
			pass
		else:
			ogs.SetCutFillColor(ConvertColor(cutForePatcolor))
		if cutForePat == None:
			pass
		else:
			ogs.SetCutFillPatternId(cutForePat.Id)
			ogs.SetCutFillPatternVisible(True)
		if cutBackPatcolor == None:
			pass
		else:
			ogs.SetCutFillColor(ConvertColor(cutBackPatcolor))
		if cutBackPat == None:
			pass
		else:
			ogs.SetCutFillPatternId(cutBackPat.Id)
			ogs.SetCutFillPatternVisible(True)
	else:
		if surfaceForePatcolor == None:
			pass
		else:
			ogs.SetSurfaceForegroundPatternColor(ConvertColor(surfaceForePatcolor))
		if surfaceForePat == None:
			pass
		else:
			ogs.SetSurfaceForegroundPatternId(surfaceForePat.Id)
			ogs.SetSurfaceForegroundPatternVisible(True)
		if surfaceBackPatcolor == None:
			pass
		else:
			ogs.SetSurfaceBackgroundPatternColor(ConvertColor(surfaceBackPatcolor))
		if surfaceBackPat == None:
			pass
		else:
			ogs.SetSurfaceBackgroundPatternId(surfaceBackPat.Id)
			ogs.SetSurfaceBackgroundPatternVisible(True)	
		if cutForePatcolor == None:
			pass
		else:
			ogs.SetCutForegroundPatternColor(ConvertColor(cutForePatcolor))
		if cutForePat == None:
			pass
		else:
			ogs.SetCutForegroundPatternId(cutForePat.Id)
			ogs.SetCutForegroundPatternVisible(True)
		if cutBackPatcolor == None:
			pass
		else:
			ogs.SetCutBackgroundPatternColor(ConvertColor(cutBackPatcolor))
		if cutBackPat == None:
			pass
		else:
			ogs.SetCutBackgroundPatternId(cutBackPat.Id)
			ogs.SetCutBackgroundPatternVisible(True)
			
TransactionManager.Instance.EnsureInTransaction(doc)
for i in views:
	for j in elems:
		output.append(i.SetElementOverrides(j.Id, ogs))	
TransactionManager.Instance.TransactionTaskDone()

if isinstance(IN[0], list): OUT = elems
else: OUT = elems[0]
# ----------------------------------------
Element = Output(python_script)
