# Dynamo custom node Printsettings from document.dyf (Dynamo 1.3.2.2480)
# category: GeniusLoci.Printing
# Get printsettings and their names from document.

Document = Input()
printsettings = Python(IN[0]=Document)
# ---------- printsettings.python (18 lines) ----------
#Copyright(c) 2015, Konrad Sobon
# @arch_laboratory, http://archi-lab.net

import clr

clr.AddReference("RevitServices")
import RevitServices
from RevitServices.Persistence import DocumentManager

clr.AddReference("RevitAPI")
import Autodesk
from Autodesk.Revit.DB import *

doc = IN[0]

ps = FilteredElementCollector(doc).OfClass(PrintSetting)

OUT = [i for i in ps],[i.Name for i in ps]
# ----------------------------------------
code_block = CodeBlock(x=printsettings) { x[0]; x[1]; }
Printsetting = Output(code_block.out0)
Printsetting_s_name = Output(code_block.out1)  # "Printsetting's name"
