# Dynamo custom node Purge Unused.dyf (Dynamo 1.3.4.6666)
# category: GeniusLoci.Utilities
# Purge the document completely including materials an assets using the API.
# Works only in Revit 2017 and later.

RunIt = Input(RunIt :bool=false)
python_script = Python(IN[0]=RunIt)
# ---------- python_script.python (88 lines) ----------
#Part of script by Matthew Taylor translated in Python by Oliver E Green

#Alban de Chasteigner 2020
#twitter : @geniusloci_bim
#geniusloci.bim@gmail.com

import clr
import System
from System.Collections.Generic import List

clr.AddReference("RevitAPI")
import Autodesk
from Autodesk.Revit.DB import *

clr.AddReference("RevitServices")
import RevitServices
from RevitServices.Persistence import DocumentManager
from RevitServices.Transactions import TransactionManager
doc = DocumentManager.Instance.CurrentDBDocument

bool=IN[0]

#GetPurgeableElements by Oliver E Green 
def GetPurgeableElements(doc, rule_id_list):
	failure_messages = PerformanceAdviser.GetPerformanceAdviser().ExecuteRules(doc, rule_id_list)
	if failure_messages.Count > 0:
		purgeable_element_ids = failure_messages[0].GetFailingElements()
		return purgeable_element_ids

#A constant 
PURGE_GUID = "e8c63650-70b7-435a-9010-ec97660c1bda"

#A generic list of PerformanceAdviserRuleIds as required by the ExecuteRules method
rule_id_list = List[PerformanceAdviserRuleId]()

#Iterating through all PerformanceAdviser rules looking to find that which matches PURGE_GUID
for rule_id in PerformanceAdviser.GetPerformanceAdviser().GetAllRuleIds():
	if str(rule_id.Guid) == PURGE_GUID:
		rule_id_list.Add(rule_id)
		break

#Attempting to retrieve the elements which can be purged
purgeable_element_ids = GetPurgeableElements(doc, rule_id_list)

TransactionManager.Instance.EnsureInTransaction(doc)
if bool==True and purgeable_element_ids != None:
	doc.Delete(purgeable_element_ids)

toKeep=[]
elements = FilteredElementCollector(doc).WhereElementIsElementType().ToElements()
for elem in elements:
	matlist=[]
	for matid in elem.GetMaterialIds(False):
		matlist.append(matid)
	toKeep.extend(matlist)

compound=FilteredElementCollector(doc).OfClass(HostObjAttributes).WhereElementIsElementType().ToElements()
compoundStructure = [comp.GetCompoundStructure() for comp in compound]
for compoundStr in compoundStructure:
	if compoundStr != None:
		layerCount=compoundStr.LayerCount
		for j in range (0, layerCount):
			if compoundStr.GetMaterialId(j) != ElementId(-1):
				toKeep.append(compoundStr.GetMaterialId(j))

materials = FilteredElementCollector(doc).OfClass(Material).ToElementIds()

appearanceAssetIds = FilteredElementCollector(doc).OfClass(AppearanceAssetElement).ToElementIds()
#The PropertySetElement contains either the Thermal or Structural Asset
propertySet = FilteredElementCollector(doc).OfClass(PropertySetElement).ToElementIds()

thermal=[doc.GetElement(id).ThermalAssetId for id in set(toKeep)]
structural=[doc.GetElement(id).StructuralAssetId for id in set(toKeep)]
appearanceAssets=[doc.GetElement(id).AppearanceAssetId for id in set(toKeep)]

propertySet2 = [e for e in propertySet if e not in thermal and e not in structural]
appearanceAssetIds2 = [e for e in appearanceAssetIds if e not in appearanceAssets]
matToDelete=[m for m in materials if not m in toKeep]

if bool==True and appearanceAssetIds2 != None:
	[doc.Delete(a) for a in appearanceAssetIds2]
if bool==True and propertySet2 != None:
	[doc.Delete(p) for p in propertySet2]
if bool==True and matToDelete != None:
	[doc.Delete(m) for m in matToDelete]
TransactionManager.Instance.TransactionTaskDone()

OUT= len([purg for purg in purgeable_element_ids]+appearanceAssetIds2+propertySet2+matToDelete),[purg for purg in purgeable_element_ids]+appearanceAssetIds2+propertySet2+matToDelete
# ----------------------------------------
code_block = CodeBlock(x=python_script) { x[0]; x[1]; }
Count = Output(code_block.out0)
Id = Output(code_block.out1)
