# Dynamo custom node Repath CADLinks.dyf (Dynamo 1.3.4.6666)
# category: GeniusLoci.CAD Import
# Reload imported CAD from an unique folder.
# Works only in Revit 2018 and above.

RunIt = Input(RunIt : bool=false)
DirectoryPath = Input()
repath_cadlinks = Python(IN[0]=RunIt, IN[1]=DirectoryPath)
# ---------- repath_cadlinks.python (40 lines) ----------
#Inspired by Thed Hogan and Nick_Boyts
#Author Alban de Chasteigner

import clr
clr.AddReference("RevitServices")
import RevitServices
from RevitServices.Persistence import DocumentManager
from RevitServices.Transactions import TransactionManager
clr.AddReference("RevitAPI")
import RevitServices,Autodesk
from RevitServices.Persistence import DocumentManager
from RevitServices.Transactions import TransactionManager
from Autodesk.Revit.DB import *


doc = DocumentManager.Instance.CurrentDBDocument

linkInstances = FilteredElementCollector(doc).OfClass(CADLinkType)

toggle = IN[0]
folderpath  = IN[1]
outName = []
load = []
filepath = [] 

TransactionManager.Instance.EnsureInTransaction(doc)

if toggle == True:
	for link in sorted(linkInstances, key = lambda object: Element.Name.GetValue(object)):
		if link.IsExternalFileReference():
			name = Element.Name.GetValue(link)
			outName.append(name)
			path = folderpath + "\\" + name
			paths = path.rsplit(' : ',2)[0]
			link.LoadFrom(paths);
			load.append(link);
			filepath.append(paths)
		
TransactionManager.Instance.TransactionTaskDone()
OUT= load,outName,filepath
# ----------------------------------------
code_block = CodeBlock(x=repath_cadlinks) { x[0]; x[1]; x[2]; }
CADLinkType = Output(code_block.out0)
Name = Output(code_block.out1)
FilePath = Output(code_block.out2)
