# Dynamo custom node Select Linked Element.dyf (Dynamo 1.3.4.6666)
# category: GeniusLoci.Select
# Selects the linked elements and shows them by zoom to fit in the current view.
# By Cyril Poupin on Dynamo Forum

refresh = Input(refresh:bool=false)
python_script = Python(IN[0]=refresh)
# ---------- python_script.python (52 lines) ----------
#By Cyril Poupin https://forum.dynamobim.com/t/zoom-to-selected-element-in-a-linked-document/61279/6
#Some modifications by Alban de Chasteigner 2021, @geniusloci_bim 

import clr
clr.AddReference('RevitAPI')
import Autodesk
from Autodesk.Revit.DB import *

clr.AddReference('RevitAPIUI')
from Autodesk.Revit.UI import *
from Autodesk.Revit.UI.Selection import *

clr.AddReference('RevitServices')
import RevitServices
from RevitServices.Persistence import DocumentManager
doc = DocumentManager.Instance.CurrentDBDocument
uidoc = DocumentManager.Instance.CurrentUIApplication.ActiveUIDocument

uiviews = uidoc.GetOpenUIViews()
view = doc.ActiveView
uiview = [x for x in uiviews if x.ViewId == view.Id][0]

def SumBoxes(boxes):
	minx = min([b.Min.X for b in boxes])
	miny = min([b.Min.Y for b in boxes])
	minz = min([b.Min.Z for b in boxes])
	maxx = max([b.Max.X for b in boxes])
	maxy = max([b.Max.Y for b in boxes])
	maxz = max([b.Max.Z for b in boxes])
	bb = BoundingBoxXYZ()
	bb.Min = XYZ(minx,miny,minz)
	bb.Max = XYZ(maxx,maxy,maxz)
	return bb

bbx,elemInLinks=[],[]
TaskDialog.Show("Selection", "Select the linked elements and press Finish")
reflnk = uidoc.Selection.PickObjects(ObjectType.LinkedElement, "Select linked elements")
for ref in reflnk :
	lnkinst=doc.GetElement(ref)
	tfLnk = lnkinst.GetTotalTransform()
	doclnk =  lnkinst.GetLinkDocument()
	elemInLink = doclnk.GetElement(ref.LinkedElementId)
	elemInLinks.append(elemInLink)
	box = elemInLink.get_BoundingBox(None)
	box.Min = tfLnk.OfPoint(box.Min)
	box.Max = tfLnk.OfPoint(box.Max)	
	bbx.append(box)
	sumBox = SumBoxes(bbx)	
	uiview.ZoomAndCenterRectangle(sumBox.Min, sumBox.Max)

if len(elemInLinks)>1: OUT = elemInLinks, lnkinst
else:OUT = elemInLinks[0], lnkinst
# ----------------------------------------
code_block = CodeBlock(x=python_script) { x[0]; x[1]; }
Element = Output(code_block.out0)
RevitLinkInstance = Output(code_block.out1)
