# Dynamo custom node SelectByCategory from document.dyf (Dynamo 1.3.3.4651)
# category: GeniusLoci.Document
# Collect elements by category from a linked or open document in the background.

Document = Input()
Category = Input()  # Lacing on Longest for various categories
bycategory_from_document = Python(IN[0]=Document, IN[1]=Category)
# ---------- bycategory_from_document.python (45 lines) ----------
# Default imports
import clr
clr.AddReference('ProtoGeometry')
from Autodesk.DesignScript.Geometry import *

# Import RevitAPI
clr.AddReference("RevitAPI")
import Autodesk
from Autodesk.Revit.DB import *

# Import DocumentManager and TransactionManager
clr.AddReference("RevitServices")
import RevitServices
from RevitServices.Persistence import DocumentManager
from RevitServices.Transactions import TransactionManager

# Import ToDSType(bool) extension method
clr.AddReference("RevitNodes")
import Revit
clr.ImportExtensions(Revit.Elements)
clr.ImportExtensions(Revit.GeometryConversion)

#Import Collections
from System.Collections.Generic import *
import System

#The inputs to this node will be stored as a list in the IN variable.
dataEnteringNode = IN

def tolist(x):
    if hasattr(x,'__iter__'): return x
    else : return [x]

doc = tolist(IN[0])

cat = IN[1]
catlist = []

for d in doc:
	collector = FilteredElementCollector(d)

bic = System.Enum.ToObject(BuiltInCategory, cat.Id)
catlist.append(collector.WhereElementIsNotElementType().OfCategory(bic).ToElements())		
		
OUT=catlist
# ----------------------------------------
code_block = CodeBlock(item=bycategory_from_document) { DSCore.List.Flatten(item,-1); }
Element = Output(code_block)
