# Dynamo custom node SelectByCategoryAnd3DView from document.dyf (Dynamo 1.3.3.4651)
# category: GeniusLoci.Document
# Collect elements by category and 3D View from a linked document.

n3DView = Input(3DView)
Category = Input()
Document = Input()  # Lacing on Longest for multiple docs
python_script = Python(IN[0]=n3DView, IN[1]=Category, IN[2]=Document)
# ---------- python_script.python (76 lines) ----------
#Inspired by Einar_Raknes
#From Alban_de_Chasteigner

import clr
clr.AddReference('RevitAPI')
clr.AddReference('System')
clr.AddReference('RevitNodes')
clr.AddReference('RevitServices')
import Revit
import RevitServices
from Autodesk.Revit.DB import *
from System.Collections.Generic import List
from RevitServices.Persistence import DocumentManager
from RevitServices.Transactions import TransactionManager
clr.ImportExtensions(Revit.Elements)
clr.ImportExtensions(Revit.GeometryConversion)

#Functions for list handling
def ProcessList(_func, _list):
   return map( lambda x: ProcessList(_func, x) if type(x)==list else _func(x), _list )

#Preparing input from dynamo to revit

def Unwrap(item):
    return UnwrapElement(item)

if isinstance(IN[0], list):
    views = ProcessList(Unwrap, IN[0])
else:
    views = [Unwrap(IN[0])]

if isinstance(IN[1], list):
	cats = ProcessList(UnwrapElement, IN[1])
else:
	cats = [UnwrapElement(IN[1])]

if isinstance(IN[2], list):
    docs = ProcessList(Unwrap, IN[2])
else:
    docs = [Unwrap(IN[2])]

viewlist = []

for view in views:
    viewlist.append(view)
    sectionbox = view.GetSectionBox()
    transform = sectionbox.Transform
    sboxoriginx = transform.Origin.X
    sboxoriginy = transform.Origin.Y
    sboxoriginz = transform.Origin.Z
    minx = sectionbox.Min.X + sboxoriginx
    maxx = sectionbox.Max.X + sboxoriginx
    miny = sectionbox.Min.Y + sboxoriginy
    maxy = sectionbox.Max.Y + sboxoriginy
    minz = sectionbox.Min.Z + sboxoriginz
    maxz = sectionbox.Max.Z + sboxoriginz
    bbox = BoundingBoxXYZ()

catlist = []
for cat in cats:
	catlist.append(cat.Id)
filtercats = List[ElementId](catlist)
catfilter = ElementMulticategoryFilter(filtercats)


	
def collectElementsInBB(bbox):
	outline = Outline(XYZ((minx), (miny), (minz)), XYZ((maxx), (maxy), (maxz)))
	bbfilter = BoundingBoxIntersectsFilter(outline)
	andfilter = LogicalAndFilter(catfilter,bbfilter)
	#collect all views in the model
	for doc in docs:
		collector = FilteredElementCollector(doc).WherePasses(andfilter)
	return [e.ToDSType(True) for e in collector]

OUT = ProcessList(collectElementsInBB,docs)[0]
# ----------------------------------------
Elements = Output(python_script)
