# Dynamo custom node SelectByCategoryAndByLevel.dyf (Dynamo 1.3.4.6666)
# category: GeniusLoci.Select
# Select Elements by Category and Level.
# With a document input, use the Collector of Levels node to get the level input.

category = Input()
docOrRevitLinkInstance = Input(docOrRevitLinkInstance : var = null)  # Use only if you want to query a linked model
selectByCategory = Python(IN[0]=category, IN[1]=docOrRevitLinkInstance)
# ---------- selectByCategory.python (41 lines) ----------
#Copyright(c) 2014, Konrad K Sobon
# Grimshaw Architects, http://grimshaw-architects.com/
# Archi-lab, http://wwww.archi-lab.net

# Default imports
import clr
clr.AddReference('RevitAPI')
import Autodesk
from Autodesk.Revit.DB import *
clr.AddReference('RevitServices')
import RevitServices
from RevitServices.Persistence import DocumentManager

#Import Collections
from System.Collections.Generic import *
import System

def tolist(x):
    if hasattr(x,'__iter__'): return x
    else : return [x]
		
cats = tolist(IN[0])
inputdocs = tolist(UnwrapElement(IN[1]))
items = []

#Part of script from Clockwork
for inputdoc in inputdocs :
	if inputdoc == None:
		doc = DocumentManager.Instance.CurrentDBDocument
	elif inputdoc.GetType().ToString() == "Autodesk.Revit.DB.Document":
		doc = inputdoc
	elif inputdoc.GetType().ToString() == "Autodesk.Revit.DB.RevitLinkInstance":
		doc = inputdoc.GetLinkDocument()
	else: doc = None

for cat in cats:
	bic = System.Enum.ToObject(BuiltInCategory, cat.Id)
	items.append(FilteredElementCollector(doc).WhereElementIsNotElementType().OfCategory(bic).ToElements())

if isinstance(IN[0], list) or isinstance(IN[1], list): OUT = items
else: OUT = items[0]
# ----------------------------------------
python_script = Python(IN[0]=selectByCategory)
# ---------- python_script.python (51 lines) ----------
import clr
clr.AddReference('RevitAPI')
from Autodesk.Revit.DB import *

clr.AddReference("RevitNodes")
import Revit
clr.ImportExtensions(Revit.Elements)

#Inspired by Clockwork
def GetLevel(item):
	val = None
	if hasattr(item, "LevelId"): 
		val = item.Document.GetElement(item.LevelId)
		if val: return val
	if hasattr(item, "Level"):
		val = item.Level
		if val: return val
	if hasattr(item, "GenLevel"):
		val = item.GenLevel
		if val: return val
	if (item.GetType().ToString() in ("Autodesk.Revit.DB.Architecture.StairsRun", "Autodesk.Revit.DB.Architecture.StairsLanding")):
		item = item.GetStairs()
	if (item.GetType().ToString() == "Autodesk.Revit.DB.Architecture.Stairs") or item.Category.Id == ElementId(BuiltInCategory.OST_Ramps):
		try: return item.Document.GetElement(item.get_Parameter(BuiltInParameter.STAIRS_BASE_LEVEL_PARAM).AsElementId())
		except: pass
	if (item.GetType().ToString() == "Autodesk.Revit.DB.ExtrusionRoof"):
		try: return item.Document.GetElement(item.get_Parameter(BuiltInParameter.ROOF_CONSTRAINT_LEVEL_PARAM).AsElementId())
		except: pass
	if (item.GetType().ToString() == "Autodesk.Revit.DB.Mechanical.Duct" or "Autodesk.Revit.DB.Electrical.Conduit"):
		try: return item.Document.GetElement(item.get_Parameter(BuiltInParameter.RBS_START_LEVEL_PARAM).AsElementId())
		except: pass
	if not val:
		try: return item.Document.GetElement(item.get_Parameter(BuiltInParameter.INSTANCE_REFERENCE_LEVEL_PARAM).AsElementId())
		except: 
			try: return item.Document.GetElement(item.get_Parameter(BuiltInParameter.INSTANCE_SCHEDULE_ONLY_LEVEL_PARAM).AsElementId())
			except: 
				try: return item.Document.GetElement(item.get_Parameter(BuiltInParameter.SCHEDULE_LEVEL_PARAM).AsElementId())
				except: return None

ProcessLists = lambda function, lists: [ProcessLists(function, item) if isinstance(item, list) else function(item) for item in lists]
ApplyFunction = lambda func, objs: ProcessLists(func, objs) if isinstance(objs, list) else [func(objs)]

def Unwrap(item):
    return UnwrapElement(item)
    
if isinstance(IN[0], list):
	items = ProcessLists(Unwrap, IN[0])
else:
	items = Unwrap(IN[0])

OUT=ApplyFunction(GetLevel,items)
# ----------------------------------------
level = Input()  # Collected level in active or linked document List Level @L1 for several levels
equals = Equals(python_script@@L1, level)
python_script_2 = Python(IN[0]=equals)
# ---------- python_script_2.python (1 lines) ----------
OUT = [[] if item is None else item for item in IN[0]]
# ----------------------------------------
filterByBoolMask = List.FilterByBoolMask(list=selectByCategory, mask=python_script_2)
Elements = Output(filterByBoolMask.in)
