# Dynamo custom node SelectByCategoryAndLevel from document.dyf (Dynamo 1.3.3.4651)
# category: GeniusLoci.Document
# Select Elements by Category and Level from linked doc or open document in the background.
# From archilab

Level = Input()  # Collected level from document
Category = Input()  # Lacing on Longest for various categories
Document = Input()
selectbycategoryandlevel_from = Python(IN[0]=Level, IN[1]=Category, IN[2]=Document)  # "SelectByCategoryAndLevel from document"
# ---------- selectbycategoryandlevel_from.python (52 lines) ----------
#Copyright(c) 2014, Konrad K Sobon
# Grimshaw Architects, http://grimshaw-architects.com/
# Archi-lab, http://wwww.archi-lab.net

# Default imports
import clr
clr.AddReference('ProtoGeometry')
from Autodesk.DesignScript.Geometry import *

# Import RevitAPI
clr.AddReference("RevitAPI")
import Autodesk
from Autodesk.Revit.DB import *

# Import DocumentManager and TransactionManager
clr.AddReference("RevitServices")
import RevitServices
from RevitServices.Persistence import DocumentManager
from RevitServices.Transactions import TransactionManager

# Import ToDSType(bool) extension method
clr.AddReference("RevitNodes")
import Revit
clr.ImportExtensions(Revit.Elements)
clr.ImportExtensions(Revit.GeometryConversion)

#Import Collections
from System.Collections.Generic import *
import System

#The inputs to this node will be stored as a list in the IN variable.
dataEnteringNode = IN

def tolist(x):
    if hasattr(x,'__iter__'): return x
    else : return [x]

doc = tolist(IN[2])

levelInput = tolist(IN[0])
cat = IN[1] 
catlist = []

for d in doc:
	collector = FilteredElementCollector(d)
for levelIn in levelInput:
	levelFilter = ElementLevelFilter(UnwrapElement(levelIn).Id)

bic = System.Enum.ToObject(BuiltInCategory, cat.Id)
catlist.append(collector.WherePasses(levelFilter).OfCategory(bic).ToElements())		
		
OUT=catlist
# ----------------------------------------
code_block = CodeBlock(item=selectbycategoryandlevel_from) { DSCore.List.Flatten(item,-1); }
Element = Output(code_block)
