# Dynamo custom node Set Material Properties.dyf (Dynamo 1.3.4.6666)
# category: GeniusLoci.Material
# Set the color, transparency, SurfaceForeground, SurfaceBackground, CutForeground and CutBackground patterns from the given material.
# Note : Prior to Revit 2019, the materials have only one surface pattern and one cut pattern.
# (All inputs are optional)

material = Input()
UseRenderAppearance = Input(UseRenderAppearance:var[]..[]=null)  # Boolean
color = Input(color:var[]..[]=null)  # Dynamo Color
Transparency = Input(Transparency:var[]..[]=null)  # Integer
SurfaceForegroundPattern = Input(SurfaceForegroundPattern:var[]..[]=null)
SurfaceForegroundPatternColor = Input(SurfaceForegroundPatternColor:var[]..[]=null)  # Dynamo Color
SurfaceBackgroundPattern = Input(SurfaceBackgroundPattern:var[]..[]=null)
SurfaceBackgroundPatternColor = Input(SurfaceBackgroundPatternColor:var[]..[]=null)  # Dynamo Color
CutForegroundPattern = Input(CutForegroundPattern:var[]..[]=null)
CutForegroundPatternColor = Input(CutForegroundPatternColor:var[]..[]=null)  # Dynamo Color
CutBackgroundPattern = Input(CutBackgroundPattern:var[]..[]=null)
CutBackgroundPatternColor = Input(CutBackgroundPatternColor:var[]..[]=null)  # Dynamo Color
python_script = Python(IN[0]=material, IN[1]=UseRenderAppearance, IN[2]=color, IN[3]=Transparency, IN[4]=SurfaceForegroundPattern, IN[5]=SurfaceForegroundPatternColor, IN[6]=SurfaceBackgroundPattern, IN[7]=SurfaceBackgroundPatternColor, IN[8]=CutForegroundPattern, IN[9]=CutForegroundPatternColor, IN[10]=CutBackgroundPattern, IN[11]=CutBackgroundPatternColor)
# ---------- python_script.python (141 lines) ----------
#Alban de Chasteigner 2019
#twitter : @geniusloci_bim
#geniusloci.bim@gmail.com

import clr
clr.AddReference('RevitAPI')
import Autodesk
from Autodesk.Revit.DB import *

clr.AddReference("RevitNodes")
import Revit
clr.ImportExtensions(Revit.Elements)

clr.AddReference("RevitServices")
import RevitServices
from RevitServices.Persistence import DocumentManager
from RevitServices.Transactions import TransactionManager

def tolist(obj1):
    if hasattr(obj1,"__iter__"): return obj1
    else: return [obj1]

def ConvertColor(e):
	return Autodesk.Revit.DB.Color(e.Red, e.Green, e.Blue)

doc = DocumentManager.Instance.CurrentDBDocument
uiapp = DocumentManager.Instance.CurrentUIApplication
app = uiapp.Application
version=int(app.VersionNumber)

materials = tolist(UnwrapElement(IN[0]))
renders=tolist(IN[1])
shadingColors=tolist(IN[2])
transparencies=tolist(IN[3])
surfaceForegroundPatterns=tolist(UnwrapElement(IN[4]))
surfaceForegroundPatternColors=tolist(IN[5])
surfaceBackgroundPatterns=tolist(UnwrapElement(IN[6]))
surfaceBackgroundPatternColors=tolist(IN[7])
cutForegroundPatterns=tolist(UnwrapElement(IN[8]))
cutForegroundPatternColors=tolist(IN[9])
cutBackgroundPatterns=tolist(UnwrapElement(IN[10]))
cutBackgroundPatternColors=tolist(IN[11])
# "Start" the transaction
TransactionManager.Instance.EnsureInTransaction(doc)
for material,render,shadingColor,transparency,surfaceForegroundPattern,surfaceForegroundPatternColor,surfaceBackgroundPattern, surfaceBackgroundPatternColor,cutForegroundPattern,cutForegroundPatternColor,cutBackgroundPattern,cutBackgroundPatternColor in zip(materials,renders,shadingColors,transparencies,surfaceForegroundPatterns,surfaceForegroundPatternColors,surfaceBackgroundPatterns,surfaceBackgroundPatternColors,cutForegroundPatterns,cutForegroundPatternColors,cutBackgroundPatterns,cutBackgroundPatternColors):
	if version < 2019 :
		if render == None:
			pass
		else:
			material.UseRenderAppearanceForShading=render
		if shadingColor == None:
			pass
		else:
			material.Color = Color(shadingColor.Red, shadingColor.Green, shadingColor.Blue)
		if transparency == None:
			pass
		else:
			material.Transparency = transparency 
		if surfaceForegroundPattern == None:
			pass
		else:	
			material.SurfacePatternId = surfaceForegroundPattern.Id
		if surfaceForegroundPatternColor == None:
			pass
		else:
			material.SurfacePatternColor = Color(surfaceForegroundPatternColor.Red, surfaceForegroundPatternColor.Green, surfaceForegroundPatternColor.Blue)
		if surfaceBackgroundPattern == None:
			pass
		else:
			material.SurfacePatternId = surfaceBackgroundPattern.Id
		if surfaceBackgroundPatternColor == None:
			pass
		else:
			material.SurfacePatternColor = Color(surfaceBackgroundPatternColor.Red, surfaceBackgroundPatternColor.Green, surfaceBackgroundPatternColor.Blue)
		if cutForegroundPattern == None:
			pass
		else:	
			material.CutPatternId = cutForegroundPattern.Id
		if cutForegroundPatternColor == None:
			pass
		else:
			material.CutPatternColor = Color(cutForegroundPatternColor.Red, cutForegroundPatternColor.Green, cutForegroundPatternColor.Blue)
		if cutBackgroundPattern == None:
			pass
		else:
			material.CutPatternId = cutBackgroundPattern.Id
		if cutBackgroundPatternColor == None:
			pass
		else:
			material.CutPatternColor = Color(cutBackgroundPatternColor.Red, cutBackgroundPatternColor.Green, cutBackgroundPatternColor.Blue)

	else:
		if render == None:
			pass
		else:
			material.UseRenderAppearanceForShading=render
		if shadingColor == None:
			pass
		else:
			material.Color = Color(shadingColor.Red, shadingColor.Green, shadingColor.Blue)
		if transparency == None:
			pass
		else:
			material.Transparency = transparency 
		if surfaceForegroundPattern == None:
			pass
		else:	
			material.SurfaceForegroundPatternId = surfaceForegroundPattern.Id
		if surfaceForegroundPatternColor == None:
			pass
		else:
			material.SurfaceForegroundPatternColor = Color(surfaceForegroundPatternColor.Red, surfaceForegroundPatternColor.Green, surfaceForegroundPatternColor.Blue)
		if surfaceBackgroundPattern == None:
			pass
		else:
			material.SurfaceBackgroundPatternId = surfaceBackgroundPattern.Id
		if surfaceBackgroundPatternColor == None:
			pass
		else:
			material.SurfaceBackgroundPatternColor = Color(surfaceBackgroundPatternColor.Red, surfaceBackgroundPatternColor.Green, surfaceBackgroundPatternColor.Blue)
		if cutForegroundPattern == None:
			pass
		else:	
			material.CutForegroundPatternId = cutForegroundPattern.Id
		if cutForegroundPatternColor == None:
			pass
		else:
			material.CutForegroundPatternColor = Color(cutForegroundPatternColor.Red, cutForegroundPatternColor.Green, cutForegroundPatternColor.Blue)
		if cutBackgroundPattern == None:
			pass
		else:
			material.CutBackgroundPatternId = cutBackgroundPattern.Id
		if cutBackgroundPatternColor == None:
			pass
		else:
			material.CutBackgroundPatternColor = Color(cutBackgroundPatternColor.Red, cutBackgroundPatternColor.Green, cutBackgroundPatternColor.Blue)
# "End" the transaction
TransactionManager.Instance.TransactionTaskDone()

if isinstance(IN[0], list): OUT = materials
else: OUT = materials[0]
# ----------------------------------------
Material = Output(python_script)
