# Dynamo custom node Set SubCategory ProjectionLineweight.dyf (Dynamo 1.3.3.4651)
# category: GeniusLoci.SubCategory
# Assigns Line weight and Line color to the Projection Line of the specified subcategory.

Category = Input()
ProjectionLineWeight = Input(ProjectionLineWeight:int)
Color = Input(Color: var= DSCore.Color.ByARGB(255,0,0,0))
python_script = Python(IN[0]=Category, IN[1]=ProjectionLineWeight, IN[2]=Color)
# ---------- python_script.python (37 lines) ----------
import clr
clr.AddReference('RevitAPI')
from Autodesk.Revit.DB import *

clr.AddReference("RevitNodes")
import Revit
clr.ImportExtensions(Revit.Elements)

clr.AddReference("RevitServices")
import RevitServices
from RevitServices.Persistence import DocumentManager
from RevitServices.Transactions import TransactionManager

doc = DocumentManager.Instance.CurrentDBDocument
cat = UnwrapElement(IN[0])
subcat = cat.SubCategories
NewlineWeight=IN[1]
lineWeight = []
listout = []
listRGB = []

# "Start" the transaction
TransactionManager.Instance.EnsureInTransaction(doc)

for i in subcat:
	weight = i.SetLineWeight(NewlineWeight,GraphicsStyleType.Projection)
	lineWeight.append(weight)
	i.LineColor = Color(IN[2].Red, IN[2].Green, IN[2].Blue)
	listRGB.append(i.LineColor)
	
	style = i.GetGraphicsStyle(GraphicsStyleType.Projection)
	listout.append(style)
	
# "End" the transaction
TransactionManager.Instance.TransactionTaskDone()

OUT = listout, NewlineWeight, IN[2]
# ----------------------------------------
code_block = CodeBlock(x=python_script) { x[0]; x[1]; x[2]; }
Graphic_Style = Output(code_block.out0)
Line_Weight = Output(code_block.out1)
Line_Color = Output(code_block.out2)
