# Dynamo custom node SpaceCentreLocation.dyf (Dynamo 1.3.2.2480)
# category: GeniusLoci.MEP
# Moves space to the centroid of the space. If the centroid is outside of the space boundary, the space will remain in its current position.
# From BVN

# note: Based on the custom node by Modelical and BVN package.
Toggle = Input(Toggle : bool)  # Boolean toggle to refresh Python nodes
python_script = Python(IN[0]=Toggle)
# ---------- python_script.python (105 lines) ----------
#Copyright(c) 2014, Nathan Miller
# The Proving Ground, http://theprovingground.org

import clr

# Import RevitAPI
clr.AddReference("RevitAPI")
import Autodesk
from Autodesk.Revit.DB import *

# Import DocumentManager and TransactionManager
clr.AddReference("RevitServices")
import RevitServices
from RevitServices.Persistence import DocumentManager
from RevitServices.Transactions import TransactionManager

# Import ToDSType(bool) extension method
clr.AddReference("RevitNodes")
import Revit
clr.ImportExtensions(Revit.Elements)
clr.ImportExtensions(Revit.GeometryConversion)

import clr
clr.AddReference('ProtoGeometry')
from Autodesk.DesignScript.Geometry import *

#The input to this node will be stored in the IN[0] variable.

doc =  DocumentManager.Instance.CurrentDBDocument
app =  DocumentManager.Instance.CurrentUIApplication.Application

toggle = IN[0]


output = []
rooms = []
names = []
numbers = []
areas = []
levels = []
boundaries = []
locations = []
elementids = []
uniqueids = []

if toggle == True:
	collector = FilteredElementCollector(doc)
	collector.OfCategory(BuiltInCategory.OST_MEPSpaces)
 
	famtypeitr = collector.GetElementIdIterator()
	famtypeitr.Reset()

	for item in famtypeitr:
		famtypeID = item
		faminst = doc.GetElement(famtypeID)
    
		#print faminst
		if faminst.Area > 0:
			room = faminst
			for p in room.Parameters:
				if p.Definition.Name == 'Name':		
					roomname = p.AsString()
				if p.Definition.Name == 'Level':			
					level = p.AsValueString()
					if (level is None):
						level = p.AsString()

			number = faminst.Number
			area = faminst.Area
			location = faminst.Location.Point.ToPoint()
			elementid = faminst.Id.ToString()
			uniqueid = faminst.UniqueId
    	
			boptions = Autodesk.Revit.DB.SpatialElementBoundaryOptions()
			boundsegs = room.GetBoundarySegments(boptions)
			boundcurves = []
			for bound in boundsegs:
				crvs = []
				for seg in bound:
					crv = seg.GetCurve()
					crvs.append(Revit.GeometryConversion.RevitToProtoCurve.ToProtoType( crv, True ))
				boundcurves.append(crvs)
    	
			rooms.append(room)
			names.append(roomname)
			numbers.append(number)
			areas.append(area)
			levels.append(level)
			locations.append(location)
			boundaries.append(boundcurves)
			elementids.append(elementid)
			uniqueids.append(uniqueid)
        
	output.append(rooms)
	output.append(names)
	output.append(numbers)
	output.append(areas)
	output.append(levels)
	output.append(locations)
	output.append(boundaries)
	output.append(elementids)
	output.append(uniqueids)
        
#Assign your output to the OUT variable
OUT = output
# ----------------------------------------
number = DoubleInput(6)
getItemAtIndex = List.GetItemAtIndex(list=python_script, index=number)
byJoinedCurves = PolyCurve.ByJoinedCurves(getItemAtIndex)
length = Curve.Length(byJoinedCurves)
python_script_2 = Python(IN[0]=length, IN[1]=byJoinedCurves)
# ---------- python_script_2.python (23 lines) ----------
import clr
clr.AddReference('ProtoGeometry')
from Autodesk.DesignScript.Geometry import *

#The inputs to this node will be stored as a list in the IN variable.
sublistsToSortBy = IN[0]
otherSublists = IN[1]

sorted_sublistsToSortBy = []
sorted_otherSublists = []

for sublist, otherSublist in zip(sublistsToSortBy, otherSublists):
  # This calculates a list of pairs (sublistItem, otherSublistItem) sorted by sublistItem.
  sorted_sublists = sorted(zip(sublist, otherSublist), key=lambda item_pair: item_pair[0])
  
  # Build the output lists
  sorted_sublistsToSortBy.append(list(sublistItem for sublistItem, otherSublistItem in sorted_sublists))
  sorted_otherSublists.append(list(otherSublistItem for sublistItem, otherSublistItem in sorted_sublists))

outList = [sorted_sublistsToSortBy, sorted_otherSublists]

#Assign your output to the OUT variable
OUT = outList
# ----------------------------------------
code_block = CodeBlock { 1; }
getItemAtIndex_2 = List.GetItemAtIndex(list=python_script_2, index=code_block)
lastItem = List.LastItem()  # unwired: arg0
map = List.Map(list=getItemAtIndex_2, f_x=lastItem)
extrudeAsSolid = Curve.ExtrudeAsSolid(map)
centroid = Solid.Centroid(extrudeAsSolid)
startPoint = Curve.StartPoint(map)
code_block_2 = CodeBlock(p1=centroid, p2=startPoint) { centroid = Autodesk.Point.ByCoordinates(p1.X, p1.Y, p2.Z); }
number_2 = DoubleInput(0)
getItemAtIndex_3 = List.GetItemAtIndex(list=python_script, index=number_2)
python_script_3 = Python(IN[0]=getItemAtIndex_3, IN[1]=code_block_2)
# ---------- python_script_3.python (24 lines) ----------
import clr
clr.AddReference('RevitAPI')
from Autodesk.Revit.DB import *

clr.AddReference("RevitNodes")
import Revit
clr.ImportExtensions(Revit.GeometryConversion)

rooms = UnwrapElement(IN[0])
points = [x.ToXyz() for x in IN[1]]
#points = UnwrapElement(IN[1])
spaceBools = []
count = 0
for r in rooms:
	try:
		if r.IsPointInSpace(points[count]):
			spaceBools.append(True)
		else:
			spaceBools.append(False)
	except:
		spaceBools.append(False)
	count = count + 1

OUT = spaceBools
# ----------------------------------------
end = Revit.Transaction.Transaction.End(python_script_3)
filterByBoolMask = List.FilterByBoolMask(list=code_block_2, mask=end)
flatten = Flatten(filterByBoolMask.in)
SpacesNotMoved = Output(flatten)
filterByBoolMask_2 = List.FilterByBoolMask(list=getItemAtIndex_3, mask=end)
flatten_2 = Flatten(filterByBoolMask_2.in)
python_script_4 = Python(IN[0]=flatten_2, IN[1]=flatten)
# ---------- python_script_4.python (38 lines) ----------
import clr
clr.AddReference('ProtoGeometry')
from Autodesk.DesignScript.Geometry import *

import clr
clr.AddReference('RevitAPI') 
clr.AddReference('RevitAPIUI') 
from Autodesk.Revit.DB import *

clr.AddReference("RevitServices")
import RevitServices
from RevitServices.Persistence import DocumentManager

clr.AddReference("RevitNodes")
import Revit
clr.ImportExtensions(Revit.GeometryConversion)

doc = DocumentManager.Instance.CurrentDBDocument
 
#The inputs to this node will be stored as a list in the IN variables.
spaces = UnwrapElement(IN[0])
points = [x.ToXyz() for x in IN[1]]
locations = []
count = 0


t = Transaction(doc, 'Move Space Location')
t.Start()
	
for r in spaces:
	P = points[count] - r.Location.Point
	r.Location.Move(P)
	count = count + 1

t.Commit()

#Assign your output to the OUT variable.
OUT = spaces
# ----------------------------------------
SpacesMoved = Output(python_script_4)
code_block_3 = CodeBlock { 0; }
getItemAtIndex_4 = List.GetItemAtIndex(list=python_script_2, index=code_block_3)
number_3 = DoubleInput(8)
getItemAtIndex_5 = List.GetItemAtIndex(list=python_script, index=number_3)
number_4 = DoubleInput(7)
getItemAtIndex_6 = List.GetItemAtIndex(list=python_script, index=number_4)
number_5 = DoubleInput(5)
getItemAtIndex_7 = List.GetItemAtIndex(list=python_script, index=number_5)
number_6 = DoubleInput(4)
getItemAtIndex_8 = List.GetItemAtIndex(list=python_script, index=number_6)
number_7 = DoubleInput(3)
getItemAtIndex_9 = List.GetItemAtIndex(list=python_script, index=number_7)
number_8 = DoubleInput(2)
getItemAtIndex_10 = List.GetItemAtIndex(list=python_script, index=number_8)
number_9 = DoubleInput(1)
getItemAtIndex_11 = List.GetItemAtIndex(list=python_script, index=number_9)
