# Dynamo custom node Tag Is Orphaned.dyf (Dynamo 1.3.4.6666)
# category: GeniusLoci.Tag
# Identify the orphaned tags.
# Orphaned tags are tags that are associated with a linked document but  no longer have a host element.

tag = Input()
python_script = Python(IN[0]=tag)
# ---------- python_script.python (25 lines) ----------
import clr
clr.AddReference("RevitAPI")
import Autodesk
from Autodesk.Revit.DB import *

clr.AddReference("RevitServices")
import RevitServices
from RevitServices.Persistence import DocumentManager
doc = DocumentManager.Instance.CurrentDBDocument

tag = UnwrapElement(IN[0])

if not hasattr(tag, '__iter__'):
	tag = [tag]

orphaned = []
taghost = []

for t in tag:
	if t.IsOrphaned:
		orphaned.append(t)
	elif not t.IsOrphaned:
		taghost.append(t)

OUT = orphaned,taghost
# ----------------------------------------
code_block = CodeBlock(x=python_script) { x[0]; x[1]; }
Orphaned_Tags = Output(code_block.out0)
Tag_with_Host = Output(code_block.out1)
