# Dynamo custom node Unload RevitLinkType from document.dyf (Dynamo 1.3.3.4651)
# category: GeniusLoci.Import
# Unloads all Revit links from a document Revit.

Document = Input()
python_script = Python(IN[0]=Document)
# ---------- python_script.python (36 lines) ----------
#From Ben_Osborne
import clr
clr.AddReference('RevitAPI')
import Autodesk
from Autodesk.Revit.DB import *
from Autodesk.Revit.Attributes import*

clr.AddReference("RevitServices")
import RevitServices
from RevitServices.Persistence import DocumentManager
from RevitServices.Transactions import TransactionManager

clr.AddReference("RevitNodes")
import Revit
clr.ImportExtensions(Revit.Elements)

dataEnteringNode = IN

def tolist(x):
    if hasattr(x,'__iter__'): return x
    else : return [x]

doc = tolist(IN[0])

revitlinktypes=list()
revitlinktypes=[]
for d in doc:
    linkcollector=FilteredElementCollector(d).OfClass(RevitLinkInstance)

TransactionManager.Instance.ForceCloseTransaction()
for rli in linkcollector:
	rlt=doc.GetElement(rli.GetTypeId())
	revitlinktypes.append(rlt)
	rlt.Unload(None)
	
OUT= revitlinktypes
# ----------------------------------------
revitLinkType = Output(python_script)
