# Dynamo custom node View Sets from document.dyf (Dynamo 1.3.3.4651)
# category: GeniusLoci.View
# Retrieve all available View Sets from document Revit.

Document = Input()
RunIt = Input()
python_script = Python(IN[0]=Document, IN[1]=RunIt)
# ---------- python_script.python (25 lines) ----------
#Copyright(c) 2015, Konrad Sobon
# @arch_laboratory, http://archi-lab.net

import clr
clr.AddReference('ProtoGeometry')
from Autodesk.DesignScript.Geometry import *

# Import DocumentManager and TransactionManager
clr.AddReference("RevitServices")
import RevitServices
from RevitServices.Persistence import DocumentManager
from RevitServices.Transactions import TransactionManager

doc = IN[0]

# Import RevitAPI
clr.AddReference("RevitAPI")
import Autodesk
from Autodesk.Revit.DB import *
import System

vs = FilteredElementCollector(doc).OfClass(ViewSheetSet)


OUT = [i.Name for i in vs],[i for i in vs]
# ----------------------------------------
code_block = CodeBlock(Names=python_script) { Names[0]; }
ViewSheetSet_s_names = Output(code_block)  # "ViewSheetSet's names"
code_block_2 = CodeBlock(ViewSheetSets=python_script) { ViewSheetSets[1]; }
ViewSheetSets = Output(code_block_2)
