# Dynamo custom node Get Extreme Column Values.dyf (Dynamo 0.6.3.7993)
# category: CEE120.Session11
# Gets the extreme values in a column

columnIndex = Input()
get_from_list = GetFromList(columnIndex)
hierarchicalList = Input()
map = Map(get_from_list, hierarchicalList)
number = DoubleInput(0)
sort_by_key = SortBy(get_from_list, hierarchicalList)
first_of_list = First(sort_by_key)
get_from_list_2 = GetFromList(number, first_of_list)
inputValueOfMin = Output(get_from_list_2)
get_from_list_3 = GetFromList(columnIndex, first_of_list)
resultValueOfMin = Output(get_from_list_3)
number_2 = DoubleInput(0)
last_of_list = Last(sort_by_key)
get_from_list_4 = GetFromList(number_2, last_of_list)
inputValueOfMax = Output(get_from_list_4)
get_from_list_5 = GetFromList(columnIndex, last_of_list)
resultValueOfMax = Output(get_from_list_5)
