# Dynamo custom node Gorilla Samples.dyf (Dynamo 1.2.0.2690)
# category: Gorilla17
# Examples & Samples

Level = Input()
List_Lines = Input()

# group: Create Duct Runs
mep_objects = MEPObject("Ducts")
element_types = ElementTypes("MechanicalSystemType")
all_elements_of_type = ElementsOfType(element_types)
firstItem = List.FirstItem(all_elements_of_type)
element_types_2 = ElementTypes("DuctType")
all_elements_of_type_2 = ElementsOfType(element_types_2)
firstItem_2 = List.FirstItem(all_elements_of_type_2)
curves = Element.Curves(List_Lines)
startPoint = Curve.StartPoint(curves)
endPoint = Curve.EndPoint(curves)
createMEPbyPoints = Gorilla.MEPObjects.CreateMEP.CreateMEPbyPoints(mep_objects, firstItem, firstItem_2, Level, startPoint, endPoint)

# note: Gets the MEP Connectors from Runs
getConnectors = Gorilla.Connectors.MEPConnectors.GetConnectors(createMEPbyPoints)
flatten = Flatten(getConnectors)
code_block = CodeBlock(x=flatten) { x[1]; x[2]; }
# note: To Create Elbows/Tee's you need to make sure there is space available and the points are not in the same location just like in Normal Revit
addElbow = Gorilla.MEPObjects.AddMEPFittings.AddElbow(code_block.out0, code_block.out1)
Room = Input()
Element = Input()

# group: Pathfinding
boundingBox = Element.BoundingBox(Room)
code_block_2 = CodeBlock { 0; 20; }
routePoint = Gorilla.Routing.DynamoWorld.RoutePoint(code_block_2.out1, code_block_2.out1, code_block_2.out1)
routePoint_2 = Gorilla.Routing.DynamoWorld.RoutePoint(code_block_2.out0, code_block_2.out0, code_block_2.out0)
geometry = Element.Geometry(Element)
flatten_2 = Flatten(geometry)
create = List.Create(flatten_2)
pathFind3D = Gorilla.Routing.DynamoWorld.PathFind3D(boundingBox, routePoint, routePoint_2, routePoint, create)

Point = Output(pathFind3D)  # "Point[]"
