# Dynamo custom node gridarray2.dyf (Dynamo 1.1.0.2093)
# category: Geometry
# gridarray2

number_slider = DoubleSlider(20, range=0..100 step 0.1)
number = DoubleInput(0..#a..1, number_slider, lacing=Longest)
number_slider_2 = DoubleSlider(20, range=0..100 step 0.1)
number_2 = DoubleInput(0..#a..1, number_slider_2, lacing=Longest)
watch = Watch(number_2)
byCoordinates = Point.ByCoordinates(x=number, y=watch, lacing=CrossProduct)
