# Dynamo custom node Floor.Boundaries.dyf (Dynamo 0.8.2.2392)
# category: Hollandaise.Revit.Elements
# returns the boundaries of a floor

a = Input()
floor_boundaries = Python(IN[0]=a)
# ---------- floor_boundaries.python (61 lines) ----------
# code borrowed and modified from The Proving Ground, http://theprovingground.org by Nate Holland
import clr

# Import RevitAPI
clr.AddReference("RevitAPI")
import Autodesk
from Autodesk.Revit.DB import *

# Import DocumentManager and TransactionManager
clr.AddReference("RevitServices")
import RevitServices
from RevitServices.Persistence import DocumentManager
from RevitServices.Transactions import TransactionManager

# Import ToDSType(bool) extension method
clr.AddReference("RevitNodes")
import Revit
clr.ImportExtensions(Revit.Elements)

#The input to this node will be stored in the IN[0] variable.

doc =  DocumentManager.Instance.CurrentDBDocument
app =  DocumentManager.Instance.CurrentUIApplication.Application

output = []
boundaries = []



floors=UnwrapElement(IN[0])

for floor in floors:    	
	boptions = app.Create.NewGeometryOptions()
	floorgeo = floor.get_Geometry(boptions)
	faces = []
	
	#cycles through all the geometry in the floor
	for geo in floorgeo:
   		instance = geo		
    	solidface = instance.Faces
    	
    	#cycles through all the faces in the geometry
    	for face in solidface:
    		faces.append(face)
    #gets tge edgeloop of the face
	edgeloops = faces[1].EdgeLoops
	edges = []
	for loop in edgeloops:
		edgs = []
		#cycles through the curves that make up the boundary and converts to dynamo geo
		for edge in loop:
			edgs.append(Revit.GeometryConversion.RevitToProtoCurve.ToProtoType( edge.AsCurve(), True ))
		edges.append(edgs)
    	

	boundaries.append(edges)


        
#Assign your output to the OUT variable
OUT = boundaries
# ----------------------------------------
OUT = Output(floor_boundaries)
