# Dynamo custom node List.DuplicateToMatch.dyf (Dynamo 0.9.0.3067)
# category: Hollandaise.List
# Duplicates the items in list1 so that they match the number of items in the sublists of list2

list1 = Input()
list2 = Input()
count = List.Count()
map = List.Map(list=list2, f_x=count)
cycle = List.Cycle(list=list1, amount=map, lacing=Longest)
code_block = CodeBlock { 1; }
flatten = List.Flatten(list=cycle, amt=code_block)
List1 = Output(flatten)
List2 = Output(list2)
