# Dynamo custom node Sheet.GetViewports.dyf (Dynamo 0.9.0.3067)
# category: Hollandaise.Revit
# returns all of the viewports on a sheet

Sheet = Input()
python_script = Python(IN[0]=Sheet)
# ---------- python_script.python (19 lines) ----------
import clr
clr.AddReference('ProtoGeometry')
from Autodesk.DesignScript.Geometry import *
# Import DocumentManager and TransactionManager
clr.AddReference("RevitServices")
import RevitServices
from RevitServices.Persistence import DocumentManager
from RevitServices.Transactions import TransactionManager
#The inputs to this node will be stored as a list in the IN variable.
dataEnteringNode = IN
Sheet=UnwrapElement(IN[0])
doc = DocumentManager.Instance.CurrentDBDocument
#Assign your output to the OUT variable
views=Sheet.GetAllViewports()
viewports=[]
for view in views:
		viewports.append(doc.GetElement(view))
	
OUT = viewports
# ----------------------------------------
Viewports = Output(python_script)
