# Dynamo custom node String.ProperCase.dyf (Dynamo 0.9.0.3067)
# category: Hollandaise.String
# puts the string in proper case, first letter of each word is capitalized

IN_0 = Input()  # "IN[0]"
python_script = Python(IN[0]=IN_0)
# ---------- python_script.python (11 lines) ----------
import clr
import sys
sys.path.append(r'C:\Program Files (x86)\IronPython 2.7\Lib')
import string
clr.AddReference('ProtoGeometry')
from Autodesk.DesignScript.Geometry import *
#The inputs to this node will be stored as a list in the IN variables.
dataEnteringNode = IN

#Assign your output to the OUT variable.
OUT = string.capwords(IN[0])
# ----------------------------------------
OUT = Output(python_script)
