# Dynamo custom node String.ProperCaseWithExclusions.dyf (Dynamo 0.9.0.3067)
# category: Hollandaise.String
# converts a string to proper case, but excludes any whole words from a list of exclusions

code_block = CodeBlock { " "; }
str = Input(str : string)
code_block_2 = CodeBlock { " "; }
split = String.Split(str, code_block_2)
y = Input(y : var[]..[])
eq = split == y  # lacing=CrossProduct
code_block_3 = CodeBlock { true; }
containsItem = List.ContainsItem(item=code_block_3)
map = List.Map(list=eq, f_x=containsItem)
filterByBoolMask = List.FilterByBoolMask(list=split, mask=map)
properCase = Custom[String.ProperCase]()  # puts the string in proper case, first letter of each word is capitalized
map_2 = List.Map(list=filterByBoolMask.out, f_x=properCase)
join = List.Join(filterByBoolMask.in, map_2)
count = List.Count(split)
code_block_4 = CodeBlock(count=count) { 0..count-1; }
filterByBoolMask_2 = List.FilterByBoolMask(list=code_block_4, mask=map)
join_2 = List.Join(filterByBoolMask_2.in, filterByBoolMask_2.out)
sortByKey = SortByKey(join, join_2)
join_3 = String.Join(code_block, sortByKey)
str_2 = Output(join_3)  # "str"
