# Dynamo custom node Switch.dyf (Dynamo 0.9.0.3067)
# category: Hollandaise.List
# simulates a switch statement

Default = Input()
input = CodeBlock(Default=Default) { Default; }
Values = Input()
input_2 = CodeBlock(Values=Values) { Values; }
addItemToFront = List.AddItemToFront(item=input, list=input_2)
Check = Input()
input_3 = CodeBlock(Check=Check) { Check; }
Cases = Input()
input_4 = CodeBlock(Cases=Cases) { Cases; }
firstIndexOf = List.FirstIndexOf(list=input_4)
map = List.Map(list=input_3, f_x=firstIndexOf)
code_block = CodeBlock(a=map) { a+1; }
getItemAtIndex = List.GetItemAtIndex(list=addItemToFront, index=code_block)
code_block_2 = CodeBlock(out=getItemAtIndex) { out; }
Output = Output(code_block_2)  # ""
