# Dynamo custom node Sort Panel by UV.DYF (Dynamo 0.8.2.2392)
# category: Hollandaise.Revit.Elements
# Sorts CW panels by the UV of the host wall

panels = Input()
panelPlane = CurtainPanel.PanelPlane(panels)
origin = Plane.Origin(panelPlane)
host = Input()
python_script = Python(IN[0]=host)
# ---------- python_script.python (13 lines) ----------
import clr
clr.AddReference('RevitAPI')
from Autodesk.Revit.DB import *

clr.AddReference("RevitNodes")
import Revit
clr.ImportExtensions(Revit.GeometryConversion)
#The inputs to this node will be stored as a list in the IN variables.
dataEnteringNode = IN
wall=UnwrapElement(IN[0])
b=wall.Location
#Assign your output to the OUT variable.
OUT = b.Curve.ToProtoType()
# ----------------------------------------
ZAxis = Vector.ZAxis()
code_block = CodeBlock { "Unconnected Height"; }
getParameterValueByName = Element.GetParameterValueByName(element=host, parameterName=code_block)
extrude = Curve.Extrude(curve=python_script, direction=ZAxis, distance=getParameterValueByName)
UVParameterAtPoint = Surface.UVParameterAtPoint(extrude)
map = List.Map(list=origin, f_x=UVParameterAtPoint)
U = UV.U(map)
flatten = Flatten(U)
V = UV.V(map)
flatten_2 = Flatten(V)
create = List.Create(panels, flatten, flatten_2)
transpose = List.Transpose(create)
python_script_2 = Python(IN[0]=transpose)
# ---------- python_script_2.python (12 lines) ----------
import clr
import operator
clr.AddReference('ProtoGeometry')
from Autodesk.DesignScript.Geometry import *
#The inputs to this node will be stored as a list in the IN variables.
dataEnteringNode = IN
Data=IN[0]
list=Data
Data.sort(key=lambda row: row[1])
list = sorted(list, key=operator.itemgetter(2,1))
#Assign your output to the OUT variable.
OUT = list
# ----------------------------------------
transpose_2 = List.Transpose(python_script_2)
code_block_2 = CodeBlock { 0; 1; 2; }
getItemAtIndex = List.GetItemAtIndex(list=transpose_2, index=code_block_2.out0)
panels_2 = Output(getItemAtIndex)  # "panels"
getItemAtIndex_2 = List.GetItemAtIndex(list=transpose_2, index=code_block_2.out1)
Uvals = Output(getItemAtIndex_2)
getItemAtIndex_3 = List.GetItemAtIndex(list=transpose_2, index=code_block_2.out2)
Vvals = Output(getItemAtIndex_3)
