# Dynamo custom node Add Filter to View.dyf (Dynamo 1.0.0.1180)
# category: Hot Gear.View
# Add Filter to View

View = Input()
Filter_ID = Input()  # "Filter.ID"
python_script = Python(IN[0]=View, IN[1]=Filter_ID)
# ---------- python_script.python (40 lines) ----------
import clr
clr.AddReference('ProtoGeometry')
from Autodesk.DesignScript.Geometry import *

# Import DocumentManager and TransactionManager
clr.AddReference("RevitServices")
import RevitServices
from RevitServices.Persistence import DocumentManager
from RevitServices.Transactions import TransactionManager

# Import RevitAPI
clr.AddReference("RevitAPI")
import Autodesk
from Autodesk.Revit.DB import *

doc = DocumentManager.Instance.CurrentDBDocument

from System.Collections.Generic import *

# Import ToDSType(bool) extension method
clr.AddReference("RevitNodes")
import Revit
clr.ImportExtensions(Revit.Elements)

view = UnwrapElement(IN[0])
filterid = IN[1]
count = 0
result = []
TransactionManager.Instance.EnsureInTransaction(doc)
while (count < len(filterid)):
	try:
		Autodesk.Revit.DB.View.AddFilter(view,filterid[count])
		result.append("Success")
		count = count + 1
	except:
		result.append("filter already in view")
		count = count + 1
TransactionManager.Instance.TransactionTaskDone()

OUT = result
# ----------------------------------------
Result = Output(python_script)
