# Dynamo custom node Add Shared Parameter to Family.dyf (Dynamo 0.8.2.2392)
# category: Hot Gear.SharedParameter
# Add Shared Parameter to family and save to the Directory Path.

Parameter_Def = Input()  # "Parameter.Def"
Instance = Input()
Parameter_Group = Input()  # "Parameter.Group"
Family = Input()
get_family_document = Custom[Get Family Document](Family=Family)
Save_Path = Input()  # "Save.Path"
add_shared_parameter_to_family = Python(IN[0]=Parameter_Def, IN[1]=Instance, IN[2]=Parameter_Group, IN[3]=get_family_document, IN[4]=Save_Path)  # "Add Shared Parameter to Family Doc"
# ---------- add_shared_parameter_to_family.python (54 lines) ----------
import clr
clr.AddReference('ProtoGeometry')
from Autodesk.DesignScript.Geometry import *

clr.AddReference("RevitAPI")
import Autodesk
from Autodesk.Revit.DB import *

clr.AddReference("RevitServices")
import RevitServices
from RevitServices.Persistence import DocumentManager
from RevitServices.Transactions import TransactionManager
from System.Collections.Generic import *

clr.AddReference("RevitNodes")
import Revit
clr.ImportExtensions(Revit.Elements)

import System

doc = DocumentManager.Instance.CurrentDBDocument
uiapp = DocumentManager.Instance.CurrentUIApplication
app = uiapp.Application

_def = IN[0]
_instance = IN[1]
_paramGroup = IN[2]
_fdoc = IN[3]
_FM = IN[3][0].FamilyManager
_path = IN[4]
message = []
familyname = []
paths = []

def addParameter(_def,_paramGroup,_instance):
	try:
		param = FamilyManager.AddParameter(_FM, _def, _paramGroup, _instance)
		message = 'Add Parameter Success'
	except Exception,e:
		message = str(e)
	return message

TransactionManager.Instance.EnsureInTransaction(_fdoc[0])
#add parameter
for i, j, k in zip(_def,_paramGroup,_instance):
	message = addParameter(i,j,k)
#get family doc & name
for i in _fdoc:
	familyname.append(i.Title)
for i in familyname:
	paths.append(_path + "\\" + i + '.rfa')
TransactionManager.Instance.TransactionTaskDone()

OUT = message,_fdoc,paths
# ----------------------------------------
code_block = CodeBlock(x=add_shared_parameter_to_family) { x[2]; x[1]; x[0]; }
Add_Result = Output(code_block.out2)  # "Add.Result"
end = Revit.Transaction.Transaction.End(code_block.out1)
save_as_document = Custom[Save As Document](SavePath=code_block.out0, Doc=end)
Save_Result = Output(save_as_document)  # "Save.Result"
Save_Path_2 = Output(code_block.out0)  # "Save.Path"
