# Dynamo custom node AllowDisallowWallJoinAtEnd.dyf "Set WallJoin" (Dynamo 0.8.2.2392)
# category: Hot Gear.Geometry Join
# Allow/Disallow Wall Join At End.
# True=Allow.WallJoinAtEnd
# False=Disallow.WallJoinAtEnd

Elements = Input()
GETCategoryNameOfElement = Python(IN[0]=Elements)
# ---------- GETCategoryNameOfElement.python (33 lines) ----------
import clr

clr.AddReference("RevitAPI")
import Autodesk
from Autodesk.Revit.DB import *

clr.AddReference("RevitServices")
import RevitServices
from RevitServices.Persistence import DocumentManager
from RevitServices.Transactions import TransactionManager

clr.AddReference("RevitNodes")
import Revit
clr.ImportExtensions(Revit.Elements)
clr.ImportExtensions(Revit.GeometryConversion)

import clr
clr.AddReference('ProtoGeometry')
from Autodesk.DesignScript.Geometry import *

doc =  DocumentManager.Instance.CurrentDBDocument
app =  DocumentManager.Instance.CurrentUIApplication.Application

elements = UnwrapElement(IN[0])

output = []
catname = []

for item in elements:
	catname.append(item.Category.Name)
	output.append(catname)

OUT = output
# ----------------------------------------
flatten = Flatten(GETCategoryNameOfElement)
code_block = CodeBlock { "Walls"; }
eq = flatten == code_block
filterByBoolMask = List.FilterByBoolMask(list=Elements, mask=eq)
Bool = Input()
code_block_2 = CodeBlock(lsit=Bool) { Flatten({lsit}); }
wallJoinAtEnd = Python(IN[0]=filterByBoolMask.in, IN[1]=code_block_2)  # "Allow_Disallow.WallJoinAtEnd"
# ---------- wallJoinAtEnd.python (59 lines) ----------
import clr
clr.AddReference('ProtoGeometry')
from Autodesk.DesignScript.Geometry import *

clr.AddReference("RevitAPI")
import Autodesk
from Autodesk.Revit.DB import *

clr.AddReference("RevitServices")
import RevitServices
from RevitServices.Persistence import DocumentManager
from RevitServices.Transactions import TransactionManager
from System.Collections.Generic import *

clr.AddReference("RevitNodes")
import Revit
clr.ImportExtensions(Revit.Elements)

doc = DocumentManager.Instance.CurrentDBDocument

elements = UnwrapElement(IN[0])
TF = IN[1]
beginning = 0
ending = 0
result = []
TransactionManager.Instance.EnsureInTransaction(doc)
if TF[0] == True:
	while (beginning < len(elements)):
		try:
			Autodesk.Revit.DB.WallUtils.AllowWallJoinAtEnd(elements[beginning], 0)
			beginning = beginning + 1
			result.append("Success")
		except:
			beginning = beginning + 1
	while (ending < len(elements)):
		try:
			Autodesk.Revit.DB.WallUtils.AllowWallJoinAtEnd(elements[ending], 1)
			ending = ending + 1
			result.append("Success")
		except:
			ending = ending + 1
elif TF[0] == False:
	while (beginning < len(elements)):
		try:
			Autodesk.Revit.DB.WallUtils.DisallowWallJoinAtEnd(elements[beginning], 0)
			beginning = beginning + 1
			result.append("Success")
		except:
			beginning = beginning + 1
	while (ending < len(elements)):
		try:
			Autodesk.Revit.DB.WallUtils.DisallowWallJoinAtEnd(elements[ending], 1)
			ending = ending + 1
			result.append("Success")
		except:
			ending = ending + 1
TransactionManager.Instance.TransactionTaskDone()

OUT = result , elements
# ----------------------------------------
code_block_3 = CodeBlock(x=wallJoinAtEnd) { x[0]; x[1]; }
Elements_2 = Output(code_block_3.out1)  # "Elements"
Result = Output(code_block_3.out0)
