# Dynamo custom node And.dyf (Dynamo 0.8.2.2392)
# category: Hot Gear.Logic

Bool = Input()
code_block = CodeBlock { 0; 1; }
if_ = If(test=Bool, true=code_block.out1, false=code_block.out0)
Bool_2 = Input(Bool)
if_2 = If(test=Bool_2, true=code_block.out1, false=code_block.out0)
code_block_2 = CodeBlock(a=if_, b=if_2) { a+b; }
gt = code_block_2 > code_block.out1
var = Output(gt)  # "var[]..[]"
