# Dynamo custom node Create Override Graphic Settings.dyf (Dynamo 0.8.2.2392)
# category: Hot Gear.OverrideGraphicSettings

Transparency = Input(Transparency : int)
ProjectioLine_Color = Input()  # "ProjectioLine.Color"
dynamo_color_to_revit_color = Custom[Dynamo Color to Revit Color](Dynamo_Color=ProjectioLine_Color)
ProjectionFill_Color = Input()  # "ProjectionFill.Color"
dynamo_color_to_revit_color_2 = Custom[Dynamo Color to Revit Color](Dynamo_Color=ProjectionFill_Color)
ProjectionFill_Pattern_Id = Input()  # "ProjectionFill.Pattern.Id"
HalfTone = Input(HalfTone : bool)
python_script = Python(IN[0]=Transparency, IN[1]=dynamo_color_to_revit_color, IN[2]=dynamo_color_to_revit_color_2, IN[3]=ProjectionFill_Pattern_Id, IN[4]=HalfTone)
# ---------- python_script.python (32 lines) ----------
import clr
clr.AddReference('ProtoGeometry')
from Autodesk.DesignScript.Geometry import *

clr.AddReference('RevitAPI')
from Autodesk.Revit.DB import *

clr.AddReference("RevitNodes")
import Revit
clr.ImportExtensions(Revit.Elements)

clr.AddReference("RevitServices")
import RevitServices
from RevitServices.Persistence import DocumentManager
from RevitServices.Transactions import TransactionManager

doc = DocumentManager.Instance.CurrentDBDocument

trans = IN[0]
pjlc = IN[1]
pjfc = IN[2]
pjfp = IN[3]
ht = IN[4]

override = OverrideGraphicSettings()
override.SetSurfaceTransparency(trans)
override.SetProjectionLineColor(pjlc)
override.SetProjectionFillColor(pjfc)
override.SetProjectionFillPatternId(pjfp)
override.SetHalftone(ht)

OUT = override
# ----------------------------------------
Override_Setting = Output(python_script)  # "Override.Setting"
