# Dynamo custom node Create Pipe.dyf (Dynamo 0.8.2.2392)
# category: Hot Gear.SystemFamily

System_Type = Input()  # "System.Type"
get_element_revit_id = Custom[Revit ID](Element=System_Type)
Pipe_Type = Input()  # "Pipe.Type"
get_element_revit_id_2 = Custom[Revit ID](Element=Pipe_Type)
Level = Input()
get_element_revit_id_3 = Custom[Revit ID](Element=Level)
Start_Point = Input()  # "Start.Point"
dynamo_point_to_revit_point = Custom[Dynamo Point To Revit Point](Dynamo_Point=Start_Point)
End_Point = Input()  # "End.Point"
dynamo_point_to_revit_point_2 = Custom[Dynamo Point To Revit Point](Dynamo_Point=End_Point)
python_script = Python(IN[0]=get_element_revit_id, IN[1]=get_element_revit_id_2, IN[2]=get_element_revit_id_3, IN[3]=dynamo_point_to_revit_point, IN[4]=dynamo_point_to_revit_point_2)
# ---------- python_script.python (43 lines) ----------
import clr
# Import RevitAPI
clr.AddReference("RevitAPI")
import Autodesk

clr.AddReference("RevitNodes")
import Revit

# Import DocumentManager and TransactionManager
clr.AddReference("RevitServices")
import RevitServices
from RevitServices.Persistence import DocumentManager
from RevitServices.Transactions import TransactionManager

# Import geometry conversion extension methods
clr.ImportExtensions(Revit.GeometryConversion)

# Import Element wrapper extension methods
clr.ImportExtensions(Revit.Elements)
doc = DocumentManager.Instance.CurrentDBDocument

systemTypeId =IN[0]
pipeTypeId = IN[1]
levelId = IN[2]
startPoint = IN[3]
endPoint = IN[4]

list = len(startPoint)
count = 0
pipelist = []

TransactionManager.Instance.EnsureInTransaction(doc)
while (count < list):
	try:
		result = Autodesk.Revit.DB.Plumbing.Pipe.Create(doc,systemTypeId[0],pipeTypeId[0],levelId[0],startPoint[count],endPoint[count])
		count = count + 1
		pipelist.append(result)
	except:
		count = count +1
		
TransactionManager.Instance.TransactionTaskDone()

OUT = pipelist
# ----------------------------------------
Result = Output(python_script)
