# Dynamo custom node Create Wall by Floor Boundaries.dyf (Dynamo 1.0.0.1180)
# category: Hot Gear.SystemFamily
# Create Wall by Floor Boundaries

Floor_Boundary = Input()  # "Floor.Boundary"
byJoinedCurves = PolyCurve.ByJoinedCurves(Floor_Boundary)
length = Curve.Length(byJoinedCurves)
code_block = CodeBlock { 1; }
code_block_2 = CodeBlock { false; }
offset = PolyCurve.Offset(byJoinedCurves, code_block, code_block_2)
length_2 = Vector.Length(offset)
gt = length > length_2
filterByBoolMask = List.FilterByBoolMask(list=byJoinedCurves, mask=gt)
reverse = Curve.Reverse(filterByBoolMask.in)
join = List.Join(reverse, filterByBoolMask.out)
Offset = Input(Offset : double)
offset_2 = PolyCurve.Offset(join, Offset, code_block_2)
flatten = Flatten(offset_2)
byJoinedCurves_2 = PolyCurve.ByJoinedCurves()
map = List.Map(list=flatten, f_x=byJoinedCurves_2)
curves = PolyCurve.Curves(map)
Wall_Height = Input()  # "Wall.Height"
WallBase_Level = Input()  # "WallBase.Level"
Wall_Type = Input()  # "Wall.Type"
byCurveAndHeight = Wall.ByCurveAndHeight(curve=curves, height=Wall_Height, level=WallBase_Level, wallType=Wall_Type)
Result = Output(byCurveAndHeight)
