# Dynamo custom node Create Wall by Room Boundaries.dyf (Dynamo 1.0.0.1180)
# category: Hot Gear.SystemFamily
# Create Wall by Room Boundaries

Room_Boundaries = Input()  # "Room.Boundaries"
byJoinedCurves = PolyCurve.ByJoinedCurves(Room_Boundaries)
length = Curve.Length(byJoinedCurves)
code_block = CodeBlock { 1; }
code_block_2 = CodeBlock { false; }
offset = PolyCurve.Offset(byJoinedCurves, code_block, code_block_2)
length_2 = Vector.Length(offset)
gt = length > length_2
code_block_3 = CodeBlock { true; }
replaceNull = Python(IN[0]=gt, IN[1]=code_block_3)  # "List.ReplaceNull"
# ---------- replaceNull.python (8 lines) ----------
items = IN[0]
rep = IN[1]
elementlist = list()
for item in items:
	if item is None: 
		item = rep
	elementlist.append(item)
OUT = elementlist
# ----------------------------------------
filterByBoolMask = List.FilterByBoolMask(list=byJoinedCurves, mask=replaceNull)
reverse = Curve.Reverse(filterByBoolMask.in)
join = List.Join(reverse, filterByBoolMask.out)
flatten = Flatten(join)
Offset = Input(Offset : double)
offset_2 = PolyCurve.Offset(flatten, Offset, code_block_2)
byJoinedCurves_2 = PolyCurve.ByJoinedCurves()
map = List.Map(list=offset_2, f_x=byJoinedCurves_2)

# group: #Copyright(c) 2015, Konrad K Sobon # @arch_laboratory, http://archi-lab.net
clear_list = Python(IN[0]=map)
# ---------- clear_list.python (23 lines) ----------
#Copyright(c) 2015, Konrad K Sobon
# @arch_laboratory, http://archi-lab.net

import clr
clr.AddReference('ProtoGeometry')
from Autodesk.DesignScript.Geometry import *
#The inputs to this node will be stored as a list in the IN variable.
dataEnteringNode = IN

def ClearList(_list):
    out = []
    for _list1 in _list:
        if _list1 is None:
            continue
        if isinstance(_list1, list):
             _list1 = ClearList(_list1)
             if not _list1:
                 continue
        out.append(_list1)
    return out

#Assign your output to the OUT variable
OUT = ClearList(IN[0])
# ----------------------------------------

curves = PolyCurve.Curves(clear_list)
Wall_Height = Input()  # "Wall.Height"
WallBase_Level = Input()  # "WallBase.Level"
WallType = Input()
byCurveAndHeight = Wall.ByCurveAndHeight(curve=curves, height=Wall_Height, level=WallBase_Level, wallType=WallType)
Result = Output(byCurveAndHeight)
