# Dynamo custom node Distance Between Point.dyf (Dynamo 0.9.0.3067)
# category: Hot Gear.Point
# Calculate the distance between 2 set of Point.

Point = Input()
Point_2 = Input(Point)
distance_between_point = Python(IN[0]=Point, IN[1]=Point_2)
# ---------- distance_between_point.python (31 lines) ----------
import clr
clr.AddReference('ProtoGeometry')
from Autodesk.DesignScript.Geometry import *
import math

P0 = IN[0]
P1 = IN[1]

def xy(p):
	x0=[]
	y0=[]
	for i in p:
		x0.append(i.X)
		y0.append(i.Y)
	return x0,y0
	
def distance(x0, x1, y0, y1):
	result=[]
	count = 0
	while count<len(x0):
		result.append(math.sqrt((x0[count] - x1[count])**2 + (y0[count] - y1[count])**2))
		count += 1
	return result
	
x0=xy(P0)[0]
y0=xy(P0)[1]
x1=xy(P1)[0]
y1=xy(P1)[1]
result = distance(x0,x1,y0,y1)
	
OUT = result
# ----------------------------------------
Distance = Output(distance_between_point)
