# Dynamo custom node Dynamo Color to Revit Color.dyf (Dynamo 0.8.2.2392)
# category: Hot Gear.Python

Dynamo_Color = Input()  # "Dynamo.Color"
red = Color.Red(Dynamo_Color)
green = Color.Green(Dynamo_Color)
blue = Color.Blue(Dynamo_Color)
python_script = Python(IN[0]=red, IN[1]=green, IN[2]=blue)
# ---------- python_script.python (21 lines) ----------
import clr
clr.AddReference('ProtoGeometry')
from Autodesk.DesignScript.Geometry import *

clr.AddReference('RevitAPI')
from Autodesk.Revit.DB import *

clr.AddReference("RevitNodes")
import Revit
clr.ImportExtensions(Revit.Elements)

clr.AddReference("RevitServices")
import RevitServices
from RevitServices.Persistence import DocumentManager
from RevitServices.Transactions import TransactionManager

doc = DocumentManager.Instance.CurrentDBDocument

color = Color(IN[0],IN[1],IN[2])

OUT = color
# ----------------------------------------
Revit_Color = Output(python_script)  # "Revit.Color"
