# Dynamo custom node Dynamo Point To Revit Point.dyf (Dynamo 0.8.2.2392)
# category: Hot Gear.Python

Dynamo_Point = Input()  # "Dynamo.Point"
code_block = CodeBlock(item=Dynamo_Point) { Flatten({item}); }
dynamo_point_to_revit_point = Python(IN[0]=code_block)
# ---------- dynamo_point_to_revit_point.python (28 lines) ----------
import clr

# Import RevitAPI
clr.AddReference("RevitAPI")
import Autodesk

clr.AddReference("RevitNodes")
import Revit

# Import DocumentManager and TransactionManager
clr.AddReference("RevitServices")
import RevitServices
from RevitServices.Persistence import DocumentManager
from RevitServices.Transactions import TransactionManager

# Import geometry conversion extension methods
clr.ImportExtensions(Revit.GeometryConversion)

# Import Element wrapper extension methods
clr.ImportExtensions(Revit.Elements)

# Unwrap the Point, yielding a Revit XYZ in Revit unit system
xyz = []
for i in IN[0]:
	point = i.ToXyz() 
	xyz.append(point)

OUT = xyz
# ----------------------------------------
Revit_Point = Output(dynamo_point_to_revit_point)  # "Revit.Point"
