# Dynamo custom node Export Families To RFA.dyf (Dynamo 0.9.0.3067)
# category: Hot Gear.Family
# Export Categories Families To Directory Folder

Path = Input()
Categories = Input(Categories : var[]..[])

# group: All Family Types Of Category ClockWork Package
code_block = CodeBlock(list=Categories) { Flatten({list}); }
clockWork = Python(IN[0]=code_block)
# ---------- clockWork.python (21 lines) ----------
import System
import clr
clr.AddReference('RevitAPI')
from Autodesk.Revit.DB import *

clr.AddReference("RevitServices")
import RevitServices
from RevitServices.Persistence import DocumentManager

doc = DocumentManager.Instance.CurrentDBDocument
cats = IN[0]

elementlist = list()
# This could be more elegant if only I knew how to implement a Multicategory filter in Python....
for item in cats:
	collector = FilteredElementCollector(doc)
	collector.OfClass(FamilySymbol)
	bic = System.Enum.ToObject(BuiltInCategory, item.Id)
	collector.OfCategory(bic)
	elementlist.append(collector.ToElements())
OUT = elementlist
# ----------------------------------------

family = FamilyType.Family(clockWork)
name = Element.Name(family)
code_block_2 = CodeBlock(a=Path, familyName=name) { a+'\'+familyName+".rfa"; }
uniqueItems = List.UniqueItems(family)
python_script = Python(IN[0]=uniqueItems)
# ---------- python_script.python (21 lines) ----------
import clr
clr.AddReference('ProtoGeometry')
from Autodesk.DesignScript.Geometry import *

clr.AddReference("RevitAPI")
import Autodesk
from Autodesk.Revit.DB import *

clr.AddReference("RevitServices")
import RevitServices
from RevitServices.Persistence import DocumentManager

doc = DocumentManager.Instance.CurrentDBDocument

family = []
fdoc = []
for i in UnwrapElement(IN[0]):
	family = Autodesk.Revit.DB.Document.EditFamily(doc,i)
	fdoc.append(family)

OUT = fdoc
# ----------------------------------------
python_script_2 = Python(IN[0]=code_block_2, IN[1]=python_script)
# ---------- python_script_2.python (17 lines) ----------
import clr
clr.AddReference('RevitAPI')
from Autodesk.Revit.DB import *

clr.AddReference("RevitServices")
import RevitServices
from RevitServices.Persistence import DocumentManager

path = IN[0]
doc = IN[1]

try:
	for i ,j in zip(path, doc):
		j.SaveAs(i)
		OUT ='Success'
except Exception,e:
	OUT = str(e)
# ----------------------------------------
OUT = Output(python_script_2)
