# Dynamo custom node Get Family Document.dyf (Dynamo 0.8.2.2392)
# category: Hot Gear.Python

Family = Input()
uniqueItems = List.UniqueItems(Family)
get_family_document = Python(IN[0]=uniqueItems)
# ---------- get_family_document.python (21 lines) ----------
import clr
clr.AddReference('ProtoGeometry')
from Autodesk.DesignScript.Geometry import *

clr.AddReference("RevitAPI")
import Autodesk
from Autodesk.Revit.DB import *

clr.AddReference("RevitServices")
import RevitServices
from RevitServices.Persistence import DocumentManager

doc = DocumentManager.Instance.CurrentDBDocument
element = UnwrapElement(IN[0])
family = []
fdoc = []
for i in element:
	family = Document.EditFamily(doc,i)
	fdoc.append(family)

OUT = fdoc
# ----------------------------------------
Family_Doc = Output(get_family_document)  # "Family.Doc"
