# Dynamo custom node Get Line Pattern.dyf (Dynamo 0.8.2.2392)
# category: Hot Gear.OverrideGraphicSettings

python_script = Python()
# ---------- python_script.python (32 lines) ----------
import clr
clr.AddReference('ProtoGeometry')
from Autodesk.DesignScript.Geometry import *

# Import DocumentManager and TransactionManager
clr.AddReference("RevitServices")
import RevitServices
from RevitServices.Persistence import DocumentManager
from RevitServices.Transactions import TransactionManager

# Import RevitAPI
clr.AddReference("RevitAPI")
import Autodesk
from Autodesk.Revit.DB import *

doc = DocumentManager.Instance.CurrentDBDocument

from System.Collections.Generic import *

# Import ToDSType(bool) extension method
clr.AddReference("RevitNodes")
import Revit
clr.ImportExtensions(Revit.Elements)

#collect all views in the model
collector = FilteredElementCollector(doc)
views = collector.OfClass(LinePatternElement).ToElements()

view = []
for i in views:
	view.append(i.ToDSType(True))
OUT = view
# ----------------------------------------
Element = Output(python_script)
get_element_revit_id = Custom[Get Element Revit ID](Elements=python_script)
flatten = Flatten(get_element_revit_id)
Id = Output(flatten)
name = Element.Name(python_script)
Name = Output(name)
