# Dynamo custom node Get Revit Selection.dyf (Dynamo 0.9.0.3067)
# category: Hot Gear.Element

python_script = Python()
# ---------- python_script.python (33 lines) ----------
import clr
clr.AddReference('ProtoGeometry')
from Autodesk.DesignScript.Geometry import *

clr.AddReference("RevitNodes")
import Revit
clr.ImportExtensions(Revit.Elements)

clr.ImportExtensions(Revit.GeometryConversion)

clr.AddReference("RevitServices")
import RevitServices
from RevitServices.Persistence import DocumentManager
from RevitServices.Transactions import TransactionManager
from System.Collections.Generic import *

clr.AddReference("RevitAPI")
import Autodesk
from Autodesk.Revit.DB import *

doc = DocumentManager.Instance.CurrentDBDocument
uiapp = DocumentManager.Instance.CurrentUIApplication
app = uiapp.Application
uidoc=DocumentManager.Instance.CurrentUIApplication.ActiveUIDocument

select = []
elements = []
select = uidoc.Selection.GetElementIds()

for i in select:
		elements.append(doc.GetElement(i).ToDSType(True))

OUT = elements
# ----------------------------------------
Element = Output(python_script)
