# Dynamo custom node Get Shared Parameter Definition.dyf (Dynamo 0.8.2.2392)
# category: Hot Gear.Python

get_sharedparameterdefinition = Python()
# ---------- get_sharedparameterdefinition.python (39 lines) ----------
import clr
clr.AddReference('ProtoGeometry')
from Autodesk.DesignScript.Geometry import *

clr.AddReference("RevitAPI")
import Autodesk
from Autodesk.Revit.DB import *

clr.AddReference("RevitServices")
import RevitServices
from RevitServices.Persistence import DocumentManager
from RevitServices.Transactions import TransactionManager
from System.Collections.Generic import *

clr.AddReference("RevitNodes")
import Revit
clr.ImportExtensions(Revit.Elements)

import System

doc = DocumentManager.Instance.CurrentDBDocument
uiapp = DocumentManager.Instance.CurrentUIApplication
app = uiapp.Application

gitem = []
itemg = []
itemd = []
items = []
file = app.OpenSharedParameterFile()
group = file.Groups
for i in group:
	gitem.append(i.Name)
	itemg.append(i)
for j in itemg:
	itemd.append(j.Definitions)
for i in itemd:
	for j in i:
		items.append(j.Name)
OUT = gitem,itemg,itemd,items
# ----------------------------------------
code_block = CodeBlock(x=get_sharedparameterdefinition) { x[2]; x[3]; }
flatten = Flatten(code_block.out0)
Parameter_Def = Output(flatten)  # "Parameter.Def"
Parameter_Name = Output(code_block.out1)  # "Parameter.Name"
code_block_2 = CodeBlock(x=get_sharedparameterdefinition) { x[0]; x[1]; }
Group_Def = Output(code_block_2.out1)  # "Group.Def"
Group_Name = Output(code_block_2.out0)  # "Group.Name"
