# Dynamo custom node Join Type (SquareOff).dyf (Dynamo 0.8.2.2392)
# category: Hot Gear.Geometry Join

Element_list = Input()
create = List.Create(Element_list)
flatten = Flatten(create)
join_type_squareoff = Python(IN[0]=flatten)
# ---------- join_type_squareoff.python (33 lines) ----------
import clr
clr.AddReference("RevitAPI")
import Autodesk
from Autodesk.Revit.DB import *

clr.AddReference("RevitServices")
import RevitServices
from RevitServices.Persistence import DocumentManager
from RevitServices.Transactions import TransactionManager
from System.Collections.Generic import *

clr.AddReference("RevitNodes")
import Revit
clr.ImportExtensions(Revit.Elements)

doc = DocumentManager.Instance.CurrentDBDocument

walls = []
for i in IN[0]:
	walls.append((UnwrapElement(i)).Location)

TransactionManager.Instance.EnsureInTransaction(doc)
for j in walls:
	j.set_JoinType(0,JoinType.SquareOff)
	
for j in walls:
	j.set_JoinType(1,JoinType.SquareOff)
TransactionManager.Instance.TransactionTaskDone()

if j.get_JoinType(0) == JoinType.SquareOff or j.get_JoinType(1) == JoinType.SquareOff:
	OUT = "Success"
else:
	OUT = False
# ----------------------------------------
Success = Output(join_type_squareoff)  # "Success?"
