# Dynamo custom node JoinGeometry.dyf "Join Geometry" (Dynamo 0.8.2.2392)
# category: Hot Gear.Geometry Join
# Join Selected Geometry

Element_list = Input()
code_block = CodeBlock(item=Element_list) { a=Flatten({item}); List.Combinations(a,2,false); }
areElementsJoined = Python(IN[0]=code_block.out1)
# ---------- areElementsJoined.python (34 lines) ----------
import clr
clr.AddReference('ProtoGeometry')
from Autodesk.DesignScript.Geometry import *

clr.AddReference("RevitAPI")
import Autodesk
from Autodesk.Revit.DB import *

clr.AddReference("RevitServices")
import RevitServices
from RevitServices.Persistence import DocumentManager
from RevitServices.Transactions import TransactionManager
from System.Collections.Generic import *

clr.AddReference("RevitNodes")
import Revit
clr.ImportExtensions(Revit.Elements)

doc = DocumentManager.Instance.CurrentDBDocument
TransactionManager.Instance.EnsureInTransaction(doc)

element = UnwrapElement(IN[0])

list = len(element)
count = 0
end = []

while (count < list):
		result = Autodesk.Revit.DB.JoinGeometryUtils.AreElementsJoined(doc, element[count][0], element[count][1])
		count = count + 1
		end.append(result)

TransactionManager.Instance.TransactionTaskDone()
OUT = end
# ----------------------------------------
filterByBoolMask = List.FilterByBoolMask(list=code_block.out1, mask=areElementsJoined)
join_python_script = Python(IN[0]=filterByBoolMask.out)
# ---------- join_python_script.python (34 lines) ----------
import clr
clr.AddReference('ProtoGeometry')
from Autodesk.DesignScript.Geometry import *

clr.AddReference("RevitAPI")
import Autodesk
from Autodesk.Revit.DB import *

clr.AddReference("RevitServices")
import RevitServices
from RevitServices.Persistence import DocumentManager
from RevitServices.Transactions import TransactionManager
from System.Collections.Generic import *

clr.AddReference("RevitNodes")
import Revit
clr.ImportExtensions(Revit.Elements)

doc = DocumentManager.Instance.CurrentDBDocument
TransactionManager.Instance.EnsureInTransaction(doc)

elements = UnwrapElement(IN[0])
count = 0
result = []
while (count < len(elements)):
	try:
		Autodesk.Revit.DB.JoinGeometryUtils.JoinGeometry(doc, elements[count][0], elements[count][1])
		count = count + 1
		result.append("Seccess")
	except:
		count = count +1

TransactionManager.Instance.TransactionTaskDone()
OUT = result
# ----------------------------------------
Seccess = Output(join_python_script)  # "Seccess?"
Already_Joined = Output(filterByBoolMask.in)
