# Dynamo custom node Line is Parallel.dyf (Dynamo 0.9.0.3067)
# category: Hot Gear.Line
# Define list of line is Parallel or not and find the angle of it.

Curve = Input()
startPoint = Curve.StartPoint(Curve)
endPoint = Curve.EndPoint(Curve)
byTwoPoints = Vector.ByTwoPoints(start=startPoint, end=endPoint)
isParallel = Vector.IsParallel(byTwoPoints, byTwoPoints, lacing=CrossProduct)
boolean = BoolSelector(true)
index_of_item = Custom[Index of item](Item=boolean)
map = List.Map(list=isParallel, f_x=index_of_item)
count = Count()
map_2 = List.Map(list=map, f_x=count)
code_block = CodeBlock { 1; }
gt = map_2 > code_block
filterByBoolMask = List.FilterByBoolMask(list=map, mask=gt)
getItemAtIndex = List.GetItemAtIndex(list=Curve, index=filterByBoolMask.in)
uniqueItems = List.UniqueItems(getItemAtIndex)
flatten = Flatten(uniqueItems)
Parallel_Line = Output(uniqueItems)  # "Parallel.Line"
direction = Line.Direction(uniqueItems)
code_block_2 = CodeBlock { 1; }
byCoordinates = Vector.ByCoordinates(x=code_block_2)
angleBetween = Vector.AngleBetween(direction, byCoordinates)
Parallel_Line_Angle = Output(angleBetween)  # "Parallel.Line.Angle"
getItemAtIndex_2 = List.GetItemAtIndex(list=Curve, index=filterByBoolMask.out)
uniqueItems_2 = List.UniqueItems(getItemAtIndex_2)
flatten_2 = Flatten(uniqueItems_2)
NotParallel_Line = Output(flatten_2)  # "NotParallel.Line"
