# Dynamo custom node Read Corrdinate Interference Check.dyf (Dynamo 1.0.0.1180)
# category: Hot Gear.Interference Report
# Read the Elements Pair of Interference Report
# Element.Set1 & 2 = For Current Document
# Element.Set3 = For Link Document

File_Path = Input()  # "File.Path"
fromPath = FileObject(File_Path)  # "File.FromPath"
readFromFile = CSV.ReadFromFile(fromPath)
code_block = CodeBlock { ":"; "<td>"; "</td>"; }
split = String.Split(readFromFile, code_block.out0, code_block.out1, code_block.out2)
code_block_2 = CodeBlock(i=split) { Count(i)-4; }
code_block_3 = CodeBlock(x=split, n=code_block_2) { x[3..n]; }
code_block_4 = CodeBlock { 1; }
flatten = List.Flatten(list=code_block_3, amt=code_block_4)
trimLeadingWhitespace = String.TrimLeadingWhitespace(flatten)
isEmpty = List.IsEmpty()
map = List.Map(list=flatten, f_x=isEmpty)
filterByBoolMask = List.FilterByBoolMask(list=trimLeadingWhitespace, mask=map)
code_block_5 = CodeBlock { "id"; }
contains = String.Contains(str=filterByBoolMask.out, searchFor=code_block_5)
code_block_6 = CodeBlock { true; }
index_of_item = Custom[Index of item](Item=code_block_6)
map_2 = List.Map(list=contains, f_x=index_of_item)
flatten_2 = Flatten(map_2)
uniqueItems = List.UniqueItems(flatten_2)
getItemAtIndex = List.GetItemAtIndex(index=uniqueItems)
map_3 = List.Map(list=filterByBoolMask.out, f_x=getItemAtIndex)
transpose = List.Transpose(map_3)
code_block_7 = CodeBlock { " "; }
split_2 = String.Split(transpose, code_block_7)
flatten_3 = Flatten()
map_4 = List.Map(list=split_2, f_x=flatten_3)
code_block_8 = CodeBlock { 2; }
takeEveryNthItem = List.TakeEveryNthItem(arg1=code_block_8, arg2=code_block_8)
map_5 = List.Map(list=map_4, f_x=takeEveryNthItem)
code_block_9 = CodeBlock(x=map_5) { x[0]; x[1]; }
python_script = Python(IN[0]=code_block_9.out0)
# ---------- python_script.python (46 lines) ----------
import clr
clr.AddReference('ProtoGeometry')
from Autodesk.DesignScript.Geometry import *

clr.AddReference("RevitNodes")
import Revit
clr.ImportExtensions(Revit.Elements)

clr.AddReference("RevitServices")
import RevitServices
from RevitServices.Persistence import DocumentManager
from RevitServices.Transactions import TransactionManager

from System.Collections.Generic import *

clr.AddReference("RevitAPI")
import Autodesk
from Autodesk.Revit.DB import *

doc = DocumentManager.Instance.CurrentDBDocument
uiapp = DocumentManager.Instance.CurrentUIApplication
app = uiapp.Application

dataEnteringNode = IN

def toRvtId(_id):
	if isinstance(_id, int) or isinstance(_id, str):
		id = ElementId(int(_id))
		return id
	elif isinstance(_id, ElementId):
		return _id

ids = []
for i in IN[0]:
    ids.append(UnwrapElement(i))

elements = []
message = None
try:
	for i in ids:
		elements.append(doc.GetElement(toRvtId(i)).ToDSType(True))
except:
	message = "Invalid Id"
	pass

OUT = elements
# ----------------------------------------
Element_Set_1 = Output(python_script)  # "Element.Set.1"
python_script_2 = Python(IN[0]=code_block_9.out1)  # same code as python_script
Element_Set_2 = Output(python_script_2)  # "Element.Set.2"

# group: #Copyright(c) 2015, Konrad K Sobon # @arch_laboratory, http://archi-lab.net
get_documents = Python()
# ---------- get_documents.python (47 lines) ----------
#Copyright(c) 2015, Konrad K Sobon
# @arch_laboratory, http://archi-lab.net

# Huge thanks to Andreas Dieckmann for 
# adding link path functionality

import clr
clr.AddReference('ProtoGeometry')
from Autodesk.DesignScript.Geometry import *

# Import DocumentManager and TransactionManager
clr.AddReference("RevitServices")
import RevitServices
from RevitServices.Persistence import DocumentManager
from RevitServices.Transactions import TransactionManager

from System.Collections.Generic import *

# Import RevitAPI
clr.AddReference("RevitAPI")
import Autodesk
from Autodesk.Revit.DB import *
from Autodesk.Revit.DB.Analysis import *

doc = DocumentManager.Instance.CurrentDBDocument
uiapp = DocumentManager.Instance.CurrentUIApplication
app = uiapp.Application

# Import ToDSType(bool) extension method
clr.AddReference("RevitNodes")
import Revit
clr.ImportExtensions(Revit.Elements)

#The inputs to this node will be stored as a list in the IN variable.
dataEnteringNode = IN

collector = Autodesk.Revit.DB.FilteredElementCollector(doc)
linkInstances = collector.OfClass(Autodesk.Revit.DB.RevitLinkInstance)

linkDoc, linkName, linkPath = [], [], []
for i in linkInstances:
	linkDoc.append(i.GetLinkDocument())
	linkName.append(i.Name)
	linkPath.append(i.GetLinkDocument().PathName)


OUT = linkDoc, linkName, linkInstances, linkPath
# ----------------------------------------
number = DoubleInput(2)
getItemAtIndex_2 = List.GetItemAtIndex(list=get_documents, index=number)
number_2 = DoubleInput(3)
getItemAtIndex_3 = List.GetItemAtIndex(list=get_documents, index=number_2)
number_3 = DoubleInput(1)
getItemAtIndex_4 = List.GetItemAtIndex(list=get_documents, index=number_3)
number_4 = DoubleInput(0)
getItemAtIndex_5 = List.GetItemAtIndex(list=get_documents, index=number_4)

code_block_10 = CodeBlock { "rvt"; }
contains_2 = String.Contains(str=filterByBoolMask.out, searchFor=code_block_10)
code_block_11 = CodeBlock { true; }
index_of_item_2 = Custom[Index of item](Item=code_block_11)
map_6 = List.Map(list=contains_2, f_x=index_of_item_2)
flatten_4 = Flatten(map_6)
uniqueItems_2 = List.UniqueItems(flatten_4)
getItemAtIndex_6 = List.GetItemAtIndex(index=uniqueItems_2)
map_7 = List.Map(list=filterByBoolMask.out, f_x=getItemAtIndex_6)
contains_3 = String.Contains(searchFor=map_7)
map_8 = List.Map(list=getItemAtIndex_4, f_x=contains_3)
code_block_12 = CodeBlock { 1; }
flatten_5 = List.Flatten(list=map_8, amt=code_block_12)
filterByBoolMask_2 = List.FilterByBoolMask(list=getItemAtIndex_5)
map_9 = List.Map(list=flatten_5, f_x=filterByBoolMask_2.in)
flatten_6 = Flatten(map_9)
python_script_3 = Python(IN[0]=code_block_9.out1, IN[1]=flatten_6)
# ---------- python_script_3.python (47 lines) ----------
import clr
clr.AddReference('ProtoGeometry')
from Autodesk.DesignScript.Geometry import *

clr.AddReference("RevitNodes")
import Revit
clr.ImportExtensions(Revit.Elements)

clr.AddReference("RevitServices")
import RevitServices
from RevitServices.Persistence import DocumentManager
from RevitServices.Transactions import TransactionManager

from System.Collections.Generic import *

clr.AddReference("RevitAPI")
import Autodesk
from Autodesk.Revit.DB import *

doc = DocumentManager.Instance.CurrentDBDocument
uiapp = DocumentManager.Instance.CurrentUIApplication
app = uiapp.Application

dataEnteringNode = IN
doc = IN[1]

def toRvtId(_id):
	if isinstance(_id, int) or isinstance(_id, str):
		id = ElementId(int(_id))
		return id
	elif isinstance(_id, ElementId):
		return _id

ids = []
for i in IN[0]:
    ids.append(UnwrapElement(i))

elements = []
message = None
try:
	for i,j in zip(ids,doc):
		elements.append(j.GetElement(toRvtId(i)).ToDSType(True))
except:
	message = "Invalid Id"
	pass

OUT = elements
# ----------------------------------------
Element_Set_3 = Output(python_script_3)  # "Element.Set.3"
