# Dynamo custom node ReplaceNumberToString.dyf (Dynamo 1.0.0.1180)
# category: Hot Gear.List
# Int Number To String

list = Input(list : var[]..[])
string_from_object = FromObject()
map = List.Map(list=list, f_x=string_from_object)
code_block = CodeBlock { ".000000"; ""; }
replace = String.Replace(searchFor=code_block.out0, replaceWith=code_block.out1)
map_2 = List.Map(list=map, f_x=replace)
var = Output(map_2)  # "var[]..[]"
