# Dynamo custom node Revit Color.dyf (Dynamo 0.8.2.2392)
# category: Hot Gear.OverrideGraphicSettings
# Autodesk.Revit.DB.Color

R = Input()
G = Input()
B = Input()
python_script = Python(IN[0]=R, IN[1]=G, IN[2]=B)
# ---------- python_script.python (21 lines) ----------
import clr
clr.AddReference('ProtoGeometry')
from Autodesk.DesignScript.Geometry import *

clr.AddReference('RevitAPI')
from Autodesk.Revit.DB import *

clr.AddReference("RevitNodes")
import Revit
clr.ImportExtensions(Revit.Elements)

clr.AddReference("RevitServices")
import RevitServices
from RevitServices.Persistence import DocumentManager
from RevitServices.Transactions import TransactionManager

doc = DocumentManager.Instance.CurrentDBDocument

color = Color(IN[0],IN[1],IN[2])

OUT = color
# ----------------------------------------
OUT = Output(python_script)
