# Dynamo custom node Revit ID to Element.dyf (Dynamo 0.8.2.2392)
# category: Hot Gear.Python

Revit_ID = Input()  # "Revit.ID"
python_script = Python(IN[0]=Revit_ID)
# ---------- python_script.python (28 lines) ----------
import clr
clr.AddReference('ProtoGeometry')
from Autodesk.DesignScript.Geometry import *

clr.AddReference("RevitNodes")
import Revit
clr.ImportExtensions(Revit.Elements)

clr.AddReference("RevitServices")
import RevitServices
from RevitServices.Persistence import DocumentManager
from RevitServices.Transactions import TransactionManager

from System.Collections.Generic import *

clr.AddReference("RevitAPI")
import Autodesk
from Autodesk.Revit.DB import *

doc = DocumentManager.Instance.CurrentDBDocument

ids = IN[0]
elements = []

for i in ids:
		elements.append(doc.GetElement(i).ToDSType(True))

OUT = elements
# ----------------------------------------
Element = Output(python_script)
