# Dynamo custom node Save As Document.dyf (Dynamo 0.8.2.2392)
# category: Hot Gear.Python

SavePath = Input()
Doc = Input()
saveas_document = Python(IN[0]=SavePath, IN[1]=Doc)
# ---------- saveas_document.python (16 lines) ----------
import clr
clr.AddReference('RevitAPI')
from Autodesk.Revit.DB import *

clr.AddReference("RevitServices")
import RevitServices
from RevitServices.Persistence import DocumentManager

path = IN[0]
doc = IN[1]
try:
	for i ,j in zip(path, doc):
		j.SaveAs(i)
		OUT ='Success'
except Exception,e:
	OUT = str(e)
# ----------------------------------------
Result = Output(saveas_document)
