# Dynamo custom node Select in Revit.dyf (Dynamo 0.9.0.3067)
# category: Hot Gear.Element
# Select Elements in Revit

Element = Input()
python_script = Python(IN[0]=Element)
# ---------- python_script.python (36 lines) ----------
import clr
clr.AddReference('ProtoGeometry')
from Autodesk.DesignScript.Geometry import *

clr.AddReference("RevitNodes")
import Revit
clr.ImportExtensions(Revit.Elements)

clr.ImportExtensions(Revit.GeometryConversion)

clr.AddReference("RevitServices")
import RevitServices
from RevitServices.Persistence import DocumentManager
from RevitServices.Transactions import TransactionManager
from System.Collections.Generic import *

clr.AddReference("RevitAPI")
import Autodesk
from Autodesk.Revit.DB import *

doc = DocumentManager.Instance.CurrentDBDocument
uiapp = DocumentManager.Instance.CurrentUIApplication
app = uiapp.Application
uidoc=DocumentManager.Instance.CurrentUIApplication.ActiveUIDocument

select = []
elements = UnwrapElement(IN[0])
uisel = uidoc.Selection
result = []

for i in elements:
	select.append(i.Id)
	Icollection = List[ElementId](select)
	uisel.SetElementIds(Icollection)
	result.append("Seccess")
OUT = result
# ----------------------------------------
Result = Output(python_script)
