# Dynamo custom node SystemTypeParameterToExcel.dyf (Dynamo 1.0.0.1180)
# category: Hot Gear.ParameterToExcel
# Export System Family Type Parameter To Excel

ExcelFilePath = Input()
location = Watch(ExcelFilePath)
Types = Input()
string_from_object = FromObject(Types)
code_block = CodeBlock { 0; false; }
code_block_2 = CodeBlock { "Element Id"; "Element Guid"; "Family Name"; }
all_elements_of_type = ElementsOfType(Types)
code_block_3 = CodeBlock(list=all_elements_of_type) { Flatten({list}); }
element_type_clockworks = Python(IN[0]=code_block_3)
# ---------- element_type_clockworks.python (12 lines) ----------
import clr
clr.AddReference('RevitAPI')
from Autodesk.Revit.DB import *

items = UnwrapElement(IN[0])
typelist = list()
for item in items:
	try: 
		typelist.append(item.Document.GetElement(item.GetTypeId()))
	except:
		typelist.append(list())
OUT = typelist
# ----------------------------------------
uniqueItems = List.UniqueItems(element_type_clockworks)
connect = Flatten(uniqueItems)
watch = Watch(connect)
parameters = Element.Parameters(watch)
code_block_4 = CodeBlock(list=parameters) { Flatten({list}); }
get_name_clockworks = Python(IN[0]=code_block_4)
# ---------- get_name_clockworks.python (17 lines) ----------
import clr
clr.AddReference('RevitAPI')
clr.AddReference('RevitAPIUI')
from Autodesk.Revit.DB import *
import Autodesk

items = IN[0]
elementlist = list()
for item in items:
	try:
		elementlist.append(item.Name)
	except:
		try:
			elementlist.append(item.get_Parameter(BuiltInParameter.SYMBOL_NAME_PARAM).AsString())
		except:
			donothing = 1
OUT = elementlist
# ----------------------------------------
code_block_5 = CodeBlock(a=get_name_clockworks, b=watch)
# ---------- code_block_5.designscript (15 lines) ----------
//Get Parameter Name
A=List.Sort(a);
B=List.UniqueItems(A);

//Get Element list*Parameter no.
C=List.Count(B);
D=List.Cycle(b,C);

//Get Parameter Name*Element no.
E=List.Count(b);
F=List.Cycle(B,E);

G=List.Sort(F);
//Get Element Parameter
I=D.GetParameterValueByName(G);
# ----------------------------------------
join = List.Join(code_block_2.out0, code_block_2.out1, code_block_2.out2, code_block_5.B)
create = List.Create(join)
revit_id = Custom[Revit ID](Elements=watch)
code_block_6 = CodeBlock(list=watch) { Flatten({list}); }
get_name_clockworks_2 = Python(IN[0]=code_block_6)  # same code as get_name_clockworks
create_2 = List.Create(revit_id.Revit_ID, revit_id.GUID, get_name_clockworks_2)
code_block_7 = CodeBlock(x=code_block_5.E) { 0..x-1; x; }
sublists = List.Sublists(list=code_block_5.I, ranges=code_block_7.out0, offset=code_block_7.x)
join_2 = List.Join(create_2, sublists)
transpose = List.Transpose(join_2)
join_3 = List.Join(create, transpose)
writeToFile = Excel.WriteToFile(filePath=location, sheetName=string_from_object, startRow=code_block.out0, startCol=code_block.out0, data=join_3)
Data = Output(writeToFile)
code_block_8 = CodeBlock { "Last Export Info"; }
code_block_9 = CodeBlock { list={"Version","Build","File Path","Excel Path","Time"}; }
application_version_clock_works = Python()
# ---------- application_version_clock_works.python (10 lines) ----------
import clr
clr.AddReference("RevitServices")
import RevitServices
from RevitServices.Persistence import DocumentManager

doc = DocumentManager.Instance.CurrentDBDocument
uiapp = DocumentManager.Instance.CurrentUIApplication
app = uiapp.Application

OUT = app.VersionName, app.VersionNumber, app.VersionBuild
# ----------------------------------------
code_block_10 = CodeBlock(seq=application_version_clock_works)
# ---------- code_block_10.designscript (6 lines) ----------
seq[0];
//Name;
seq[1];
//Version;
seq[2];
//Build;
# ----------------------------------------
doc_path_from_clockworks = Python()
# ---------- doc_path_from_clockworks.python (11 lines) ----------
import clr
clr.AddReference('RevitAPI')
from Autodesk.Revit.DB import *

clr.AddReference("RevitServices")
import RevitServices
from RevitServices.Persistence import DocumentManager

doc = DocumentManager.Instance.CurrentDBDocument

OUT = doc.PathName
# ----------------------------------------
string_from_object_2 = FromObject(location)
now = DateTime.Now()
create_3 = List.Create(code_block_10.out0, code_block_10.out2, doc_path_from_clockworks, string_from_object_2, now)
create_4 = List.Create(code_block_9, create_3)
writeToFile_2 = Excel.WriteToFile(filePath=location, sheetName=code_block_8, startRow=code_block.out0, startCol=code_block.out0, data=create_4)
FileInfo = Output(writeToFile_2)
