# Dynamo custom node UnjoinGeometry.dyf "Unjoin Geometry" (Dynamo 0.8.2.2392)
# category: Hot Gear.Geometry Join
# Unjoin selected geometry

Element_list = Input()
code_block = CodeBlock(item=Element_list) { a=Flatten({item}); List.Combinations(a,2,false); }
areElementsJoined = Python(IN[0]=code_block.out1)
# ---------- areElementsJoined.python (38 lines) ----------
import clr
clr.AddReference('ProtoGeometry')
from Autodesk.DesignScript.Geometry import *

clr.AddReference("RevitAPI")
import Autodesk
from Autodesk.Revit.DB import *

clr.AddReference("RevitServices")
import RevitServices
from RevitServices.Persistence import DocumentManager
from RevitServices.Transactions import TransactionManager
from System.Collections.Generic import *

clr.AddReference("RevitNodes")
import Revit
clr.ImportExtensions(Revit.Elements)

doc = DocumentManager.Instance.CurrentDBDocument
TransactionManager.Instance.EnsureInTransaction(doc)

element = UnwrapElement(IN[0])

list = len(element)
count = 0
end = []
sublist = []

while (count < list):
		result = Autodesk.Revit.DB.JoinGeometryUtils.AreElementsJoined(doc, element[count][0], element[count][1])
		count
		count = count + 1
		sublist.append(result)
		
end.extend(sublist)

TransactionManager.Instance.TransactionTaskDone()
OUT = end
# ----------------------------------------
filterByBoolMask = List.FilterByBoolMask(list=code_block.out1, mask=areElementsJoined)
unjoin_python_script = Python(IN[0]=filterByBoolMask.in)
# ---------- unjoin_python_script.python (34 lines) ----------
import clr
clr.AddReference('ProtoGeometry')
from Autodesk.DesignScript.Geometry import *

clr.AddReference("RevitAPI")
import Autodesk
from Autodesk.Revit.DB import *

clr.AddReference("RevitServices")
import RevitServices
from RevitServices.Persistence import DocumentManager
from RevitServices.Transactions import TransactionManager
from System.Collections.Generic import *

clr.AddReference("RevitNodes")
import Revit
clr.ImportExtensions(Revit.Elements)

doc = DocumentManager.Instance.CurrentDBDocument
TransactionManager.Instance.EnsureInTransaction(doc)

elements = UnwrapElement(IN[0])
count = 0
result = []
while (count < len(elements)):
	try:
		Autodesk.Revit.DB.JoinGeometryUtils.UnjoinGeometry(doc, elements[count][0], elements[count][1])
		count = count + 1
		result.append("Seccess")
	except:
		count = count +1

TransactionManager.Instance.TransactionTaskDone()
OUT = result
# ----------------------------------------
Seccess = Output(unjoin_python_script)  # "Seccess?"
Already_Unjoined = Output(filterByBoolMask.out)
code_block_2 = CodeBlock {  }
