# Dynamo custom node View Reset Element Overrides.dyf (Dynamo 0.8.2.2392)
# category: Hot Gear.OverrideGraphicSettings

View = Input()
get_all_instance_element = Custom[Get All Instance Element]()
get_element_revit_id = Custom[Get Element Revit ID](Element=get_all_instance_element)
code_block = CodeBlock(list=get_element_revit_id) { Flatten({list}); }
python_script = Python(IN[0]=View, IN[1]=code_block)
# ---------- python_script.python (34 lines) ----------
import clr
clr.AddReference('ProtoGeometry')
from Autodesk.DesignScript.Geometry import *

clr.AddReference('RevitAPI')
from Autodesk.Revit.DB import *

clr.AddReference("RevitNodes")
import Revit
clr.ImportExtensions(Revit.Elements)

clr.AddReference("RevitServices")
import RevitServices
from RevitServices.Persistence import DocumentManager
from RevitServices.Transactions import TransactionManager

doc = DocumentManager.Instance.CurrentDBDocument

view = UnwrapElement(IN[0])
element = IN[1]
override = OverrideGraphicSettings()
result = []
count = 0

TransactionManager.Instance.EnsureInTransaction(doc)
for i in element:
	view.SetElementOverrides(i, override)
	result.append("Success")


TransactionManager.Instance.TransactionTaskDone()


OUT = result
# ----------------------------------------
Result = Output(python_script)
