# Dynamo custom node View Set Element Overrides.dyf (Dynamo 0.8.2.2392)
# category: Hot Gear.OverrideGraphicSettings

View = Input()
Element = Input()
get_element_revit_id = Custom[Get Element Revit ID](Element=Element)
code_block = CodeBlock(list=get_element_revit_id) { Flatten({list}); }
Override_Setting = Input()  # "Override.Setting"
code_block_2 = CodeBlock(list=Override_Setting) { Flatten({list}); }
python_script = Python(IN[0]=View, IN[1]=code_block, IN[2]=code_block_2)
# ---------- python_script.python (39 lines) ----------
import clr
clr.AddReference('ProtoGeometry')
from Autodesk.DesignScript.Geometry import *

clr.AddReference('RevitAPI')
from Autodesk.Revit.DB import *

clr.AddReference("RevitNodes")
import Revit
clr.ImportExtensions(Revit.Elements)

clr.AddReference("RevitServices")
import RevitServices
from RevitServices.Persistence import DocumentManager
from RevitServices.Transactions import TransactionManager

doc = DocumentManager.Instance.CurrentDBDocument

view = UnwrapElement(IN[0])
element = IN[1]
override = IN[2]
result = []
count = 0

TransactionManager.Instance.EnsureInTransaction(doc)
while (count < len(override)):
	for i in element:
		try:
			view.SetElementOverrides(i, override[count])
			result.append("Success")
			count
			count = count + 1
		except:
			view.SetElementOverrides(i, override[count-1])
			result.append("Success")
TransactionManager.Instance.TransactionTaskDone()


OUT = result
# ----------------------------------------
Result = Output(python_script)
