# Dynamo custom node View Set Filter Overrides.dyf (Dynamo 1.0.0.1180)
# category: Hot Gear.View
# Set View Filter Overrides

View = Input()
Filter_ID = Input()  # "Filter.ID"
code_block = CodeBlock(list=Filter_ID) { Flatten({list}); }
Override_Setting = Input()  # "Override.Setting"
code_block_2 = CodeBlock(list=Override_Setting) { Flatten({list}); }
python_script = Python(IN[0]=View, IN[1]=code_block, IN[2]=code_block_2)
# ---------- python_script.python (39 lines) ----------
import clr
clr.AddReference('ProtoGeometry')
from Autodesk.DesignScript.Geometry import *

clr.AddReference('RevitAPI')
from Autodesk.Revit.DB import *

clr.AddReference("RevitNodes")
import Revit
clr.ImportExtensions(Revit.Elements)

clr.AddReference("RevitServices")
import RevitServices
from RevitServices.Persistence import DocumentManager
from RevitServices.Transactions import TransactionManager

doc = DocumentManager.Instance.CurrentDBDocument

view = UnwrapElement(IN[0])
filterid = IN[1]
override = IN[2]
result = []
count = 0

TransactionManager.Instance.EnsureInTransaction(doc)
while (count < len(override)):
	for i in filterid:
		try:
			view.SetFilterOverrides(i, override[count])
			result.append("Success")
			count
			count = count + 1
		except:
			view.SetFilterOverrides(i, override[count-1])
			result.append("Success")
TransactionManager.Instance.TransactionTaskDone()


OUT = result
# ----------------------------------------
Result = Output(python_script)
