# Dynamo custom node ReadExcel.DYF (Dynamo 0.9.0.3067)
# category: Hot Gear.ExcelToParameter

File_Path = Input()
fromPath = FileObject(File_Path)  # "File.FromPath"
SheetName = Input(SheetName : string)
readFromFile = Excel.ReadFromFile(file=fromPath, sheetName=SheetName)
transpose = List.Transpose(readFromFile)
code_block = CodeBlock(a=transpose) { Z=a[0]; A = List.Count(Z); 1..A-1; 0; }
getItemAtIndex = List.GetItemAtIndex(index=code_block.out3)
map = List.Map(list=transpose, f_x=getItemAtIndex)
IndexParameter = Output(map)
getItemAtIndex_2 = List.GetItemAtIndex(index=code_block.out2)
map_2 = List.Map(list=transpose, f_x=getItemAtIndex_2)
Index = Input()
code_block_2 = CodeBlock(X=map_2, n=Index, Y=map, Z=map_2) { X[n]; Y[n]; Z[0]; }
code_block_3 = CodeBlock { ""; }
isNull = Object.IsNull()
replaceByCondition = Replace(code_block_2.out0, code_block_3, isNull)
IndexValue = Output(replaceByCondition)
IndexName = Output(code_block_2.out1)
string_from_object = FromObject(code_block_2.out2)
code_block_4 = CodeBlock { ".000000"; ""; }
replace = String.Replace(str=string_from_object, searchFor=code_block_4.out0, replaceWith=code_block_4.out1)

# group: # Copyright(c) 2015, Konrad K Sobon # @arch_laboratory, http://archi-lab.net
code_block_5 = CodeBlock(list=replace) { Flatten({list}); }
python_script = Python()
# ---------- python_script.python (29 lines) ----------
# Copyright(c) 2015, Konrad K Sobon
# @arch_laboratory, http://archi-lab.net

# Import DocumentManager
import clr
clr.AddReference("RevitServices")
import RevitServices
from RevitServices.Persistence import DocumentManager

import sys
pyt_path = r'C:\Program Files (x86)\IronPython 2.7\Lib'
sys.path.append(pyt_path)

#The inputs to this node will be stored as a list in the IN variable.
dataEnteringNode = IN

try:
	errorReport = None
	doc = DocumentManager.Instance.CurrentDBDocument
except:
	# if error accurs anywhere in the process catch it
	import traceback
	errorReport = traceback.format_exc()

#Assign your output to the OUT variable
if errorReport == None:
	OUT = doc
else:
	OUT = errorReport
# ----------------------------------------
id_to_element = Python(IN[0]=code_block_5, IN[1]=python_script)
# ---------- id_to_element.python (60 lines) ----------
#Copyright(c) 2015, Konrad Sobon
# @arch_laboratory, http://archi-lab.net

import clr
clr.AddReference('ProtoGeometry')
from Autodesk.DesignScript.Geometry import *

# Import ToDSType(bool) extension method
clr.AddReference("RevitNodes")
import Revit
clr.ImportExtensions(Revit.Elements)

# Import DocumentManager and TransactionManager
clr.AddReference("RevitServices")
import RevitServices
from RevitServices.Persistence import DocumentManager
from RevitServices.Transactions import TransactionManager

from System.Collections.Generic import *

# Import RevitAPI
clr.AddReference("RevitAPI")
import Autodesk
from Autodesk.Revit.DB import *

doc = DocumentManager.Instance.CurrentDBDocument
uiapp = DocumentManager.Instance.CurrentUIApplication
app = uiapp.Application

#The inputs to this node will be stored as a list in the IN variable.
dataEnteringNode = IN
doc = IN[1]

def toRvtId(_id):
	if isinstance(_id, int) or isinstance(_id, str):
		id = ElementId(int(_id))
		return id
	elif isinstance(_id, ElementId):
		return _id

#unwrap incoming information for use with API
ids = []
for i in IN[0]:
    ids.append(UnwrapElement(i))

#use element ids to select elements
elements = []
message = None
try:
	for i in ids:
		elements.append(doc.GetElement(toRvtId(i)).ToDSType(True))
except:
	message = "Invalid Id"
	pass

#Assign your output to the OUT variable
if message != None:
	OUT =  '\n'.join('{:^35}'.format(s) for s in message.split('\n'))
else:
	OUT = elements
# ----------------------------------------

ElementList = Output(id_to_element)
