# Dynamo custom node SetParameterByExcel.DYF (Dynamo 0.8.1.1942)
# category: Hot Gear.ExcelToParameter

RunIt = Input()
IndexName = Input()
ElementList = Input()
IndexValue = Input()
code_block = CodeBlock(Parametername=IndexName, Elementlist=ElementList, ValueofParameter=IndexValue)
# ---------- code_block.designscript (11 lines) ----------
//Get Element list*Parameter no.
C=List.Count(Parametername);
D=List.OfRepeatedItem(Elementlist,C);
E=List.Flatten(D,1);
//Get Parameter Name*Element no.
F=List.Count(Elementlist);
G=List.OfRepeatedItem(Parametername,F);
H=List.Flatten(G,1);
I=List.Sort(H);
//Get Element Parameter
K=List.Flatten(ValueofParameter,1);
# ----------------------------------------
code_block_2 = CodeBlock { null; }
if_ = If(test=RunIt, true=code_block.E, false=code_block_2)
setParameterByName = Element.SetParameterByName(element=if_, parameterName=code_block.I, value=code_block.K)
Out = Output(setParameterByName)
Element = Output(code_block.E)
ParameterName = Output(code_block.I)
ParameterValue = Output(code_block.K)
