# Dynamo custom node Formwork_Area.dyf (Dynamo 1.2.0.2690)
# category: infraBim.Construction
# Splits Surface into Top, Bottom and Sides

filterByBoolMask = List.FilterByBoolMask()  # unwired: list, mask
Input_ListSurface = Input()  # "Input.ListSurface"
normalAtParameter = Surface.NormalAtParameter(surface=Input_ListSurface)
Z = Point.Z(normalAtParameter)
code_block = CodeBlock(Z=Z) { Z==0; }
combine = List.Combine(filterByBoolMask.in, Input_ListSurface, code_block)
Surface_Sides = Output(combine)
code_block_2 = CodeBlock(Z=Z) { Z==1; }
combine_2 = List.Combine(filterByBoolMask.in, Input_ListSurface, code_block_2)
boolean = BoolSelector(false)
clean = List.Clean(list=combine_2, preserveIndices=boolean)
Surface_Top = Output(clean)
code_block_3 = CodeBlock(Z=Z) { Z==-1; }
combine_3 = List.Combine(filterByBoolMask.in, Input_ListSurface, code_block_3)
clean_2 = List.Clean(list=combine_3, preserveIndices=boolean)
Surface_Bottom = Output(clean_2)
