# Dynamo custom node Get Active Project Location Name.dyf (Dynamo 1.1.0.2094)
# category: Bakery.DocInfo
# gets the name from the document

python_script = Python()
# ---------- python_script.python (11 lines) ----------
import clr
clr.AddReference("RevitServices")
import RevitServices
from RevitServices.Persistence import DocumentManager

doc = DocumentManager.Instance.CurrentDBDocument
projloc = doc.ActiveProjectLocation
position_data = projloc.ProjectPosition[XYZ.Zero]
location_data = projloc.SiteLocation

OUT = str(doc.ActiveProjectLocation.Name)(position_data.Angle,position_data.Elevation,position_data.EastWest,position_data.NorthSouth)
# ----------------------------------------
param = Output(python_script)
