# Dynamo custom node List Index Concate.dyf (Dynamo 1.2.0.2690)
# category: infraBim.General
# List Index Concate

String = Input()
join = String.Join(arg1=String)  # unwired: arg0, arg2
list = Input(list : var[]..[])
allIndicesOf = List.AllIndicesOf(list=list, item=list)
string_from_object = FromObject(allIndicesOf)
combine = List.Combine(join, string_from_object)  # unwired: arg2
IndexString = Output(combine)
