# Dynamo custom node Point to String 3dm.dyf (Dynamo 1.2.0.2690)
# category: infraBim.Coordinates
# Point to String with 3dm

code_block = CodeBlock { ","; }
join = String.Join(code_block, lacing=Longest)  # unwired: arg1, arg2, arg3
input_X = Input()
string_from_object = FromObject(input_X)
code_block_2 = CodeBlock { 3; }
specifyDecimalPlaces = Custom[String.SpecifyDecimalPlaces](str=string_from_object, numOfDecimalPlaces=code_block_2)  # This node will take your inout string and number of decimal places to create a new simplified output.
input_Y = Input()
string_from_object_2 = FromObject(input_Y)
specifyDecimalPlaces_2 = Custom[String.SpecifyDecimalPlaces](str=string_from_object_2, numOfDecimalPlaces=code_block_2)
input_Z = Input()
string_from_object_3 = FromObject(input_Z)
specifyDecimalPlaces_3 = Custom[String.SpecifyDecimalPlaces](str=string_from_object_3, numOfDecimalPlaces=code_block_2)
combine = List.Combine(join, specifyDecimalPlaces, specifyDecimalPlaces_2, specifyDecimalPlaces_3)
x_y_Z_3dp = Output(combine)  # "x,y,Z 3dp"
