# Dynamo custom node Set Project Base Point.dyf (Dynamo 1.2.0.2690)
# category: infraBim.Coordinates
# Set Project Base Point and True North Angle

# group: Get Project Base Point Coordinates
categories = Categories("ProjectBasePoint")
all_elements_of_category = ElementsOfCategory(categories)
string = StringInput("E/W")
string_2 = StringInput("N/S")
string_3 = StringInput("Elev")
string_4 = StringInput("Angle to True North")

Input_EastWest = Input()  # "Input.EastWest"
setParameterByName = Element.SetParameterByName(element=all_elements_of_category, parameterName=string, value=Input_EastWest)
Input_NorhtSouth = Input()  # "Input.NorhtSouth"
setParameterByName_2 = Element.SetParameterByName(element=all_elements_of_category, parameterName=string_2, value=Input_NorhtSouth)
Input_Elev = Input()  # "Input.Elev"
setParameterByName_3 = Element.SetParameterByName(element=all_elements_of_category, parameterName=string_3, value=Input_Elev)
Input_AngletoTrueNorth = Input()  # "Input.AngletoTrueNorth"
setParameterByName_4 = Element.SetParameterByName(element=all_elements_of_category, parameterName=string_4, value=Input_AngletoTrueNorth)
python_script = Python()
# ---------- python_script.python (7 lines) ----------
import clr
clr.AddReference("RevitServices")
import RevitServices
from RevitServices.Persistence import DocumentManager

doc = DocumentManager.Instance.CurrentDBDocument
OUT = str(doc.ActiveProjectLocation.Name)
# ----------------------------------------
param = Output(python_script)
boolean = BoolSelector(false)
setPinnedStatus = Custom[Element.SetPinnedStatus](element=all_elements_of_category, Bool=boolean)  # Will set the element to either pinned or not pinned. True is pinned, false is unpinned. For multiple elements use List.Map
