# Dynamo custom node Transfrom_Revit_out.dyf (Dynamo 1.2.0.2690)
# category: infraBim.Coordinates
# Transforms Revit points to Real world coordinate by matrix transform rotation about the Project basepoint and True North Rotation.
# Adds Revit Project Basepoint coordinates
# Used to export point from Revit
# Adds Revit Project Basepoint coordinates
# Used to export point from Revit
# Used to export point from Revit

# group: Get Project Base Point Coordinates
categories = Categories("ProjectBasePoint")
all_elements_of_category = ElementsOfCategory(categories)
string = StringInput("Elev")
Z = Element.GetParameterValueByName(element=all_elements_of_category, parameterName=string)
list_firstitem_z = List.FirstItem(Z)
string_2 = StringInput("N/S")
Y = Element.GetParameterValueByName(element=all_elements_of_category, parameterName=string_2)
list_firstitem_y = List.FirstItem(Y)
string_3 = StringInput("E/W")
X = Element.GetParameterValueByName(element=all_elements_of_category, parameterName=string_3)
list_firstitem_x = List.FirstItem(X)
string_4 = StringInput("Angle to True North")
getParameterValueByName = Element.GetParameterValueByName(element=all_elements_of_category, parameterName=string_4)
list_firstitem_angle = List.FirstItem(getParameterValueByName)

Base_Point_Z = Output(list_firstitem_z)
Base_Point_Y = Output(list_firstitem_y)
Base_Point_X = Output(list_firstitem_x)
True_North_Rotation = Output(list_firstitem_angle)
Input_X = Input()  # "Input.X"
Input_Y = Input()  # "Input.Y"

# group: The Porject Base Point is added to the X with Matrix Transfromation
X_2 = Math.Cos(list_firstitem_angle)  # "Math.Cos.X"
x_cos = X_2 * Input_X
Y_2 = Math.Sin(list_firstitem_angle)  # "Math.Sin.Y"
sin_y = Y_2 * Input_Y
x_sin_ø_y_cos_ø_y = x_cos + sin_y
add = x_sin_ø_y_cos_ø_y + list_firstitem_x

transform_X = Output(add)  # "transform.X"
code_block = CodeBlock { -1; }

# group: The Porject Base Point is added to the Y with Matrix Transfromation
X_3 = Math.Sin(list_firstitem_angle)  # "Math.Sin.X"
x_sin = X_3 * Input_X
Y_3 = Math.Cos(list_firstitem_angle)  # "Math.Cos.Y"
y_cos = Y_3 * Input_Y

x_sin_2 = code_block * x_sin

# group (continued): The Porject Base Point is added to the Y with Matrix Transfromation
x_sin_ø_y_cos_ø_y_2 = x_sin_2 + y_cos
add_2 = x_sin_ø_y_cos_ø_y_2 + list_firstitem_y

transform_Y = Output(add_2)  # "transform.Y"
Input_Z = Input()  # "Input.Z"
add_3 = Input_Z + list_firstitem_z
transform_Z = Output(add_3)  # "transform.Z"
watch = Watch(add)
watch_2 = Watch(add_2)
