# Dynamo custom node XYZ Parameters.dyf (Dynamo 1.2.0.2690)
# category: infraBim.xyz Parameters
# X Y Z and True East and North Parameters

Input_Element = Input()  # "Input.Element"
Input_X = Input()  # "Input.X"
Input_Y = Input()  # "Input.Y"
Input_Z = Input()  # "Input.Z"

# group: Paramater Updated of X,Y,Z
string = StringInput("Coordinates_X")
setParameterByName = Element.SetParameterByName(element=Input_Element, parameterName=string, value=Input_X)
string_2 = StringInput("Coordinates_Y")
setParameterByName_2 = Element.SetParameterByName(element=Input_Element, parameterName=string_2, value=Input_Y)
string_3 = StringInput("Coordinates_Z")
setParameterByName_3 = Element.SetParameterByName(element=Input_Element, parameterName=string_3, value=Input_Z)

Input_Easting_trans_X = Input()  # "Input.Easting(trans X)"
Input_North_trans_Y = Input()  # "Input.North(trans Y)"

# group: Parameter Updated of Northing and Easting
string_4 = StringInput("True_Easting")
setParameterByName_4 = Element.SetParameterByName(element=Input_Element, parameterName=string_4, value=Input_Easting_trans_X)
string_5 = StringInput("True_Northing")
setParameterByName_5 = Element.SetParameterByName(element=Input_Element, parameterName=string_5, value=Input_North_trans_Y)
