# Dynamo custom node Loft Surfaces from List of Curves.dyf (Dynamo 0.7.2.2114)
# category: Mode Lab
# With a list of ordered curves, loft invidividual surfaces using List.ShiftIndices.

Curves = Input()
number = DoubleInput(1)
shiftIndices = List.ShiftIndices(Curves, number)
create = List.Create(Curves, shiftIndices)
transpose = List.Transpose(create)
byLoft = Surface.ByLoft(transpose)
deconstruct = List.Deconstruct(byLoft)
Surfaces = Output(deconstruct.out1)
