# Dynamo custom node Dictionary.ByKeysValues.dyf (Dynamo 1.3.0.875)
# category: MEPTools.Core
# Search value by keys

keys = Input(keys:var[])
values = Input(values:var[])
searchKeys = Input(searchKeys:var[])
# note: This python codes get from Spring Package.
python_script = Python(IN[0]=keys, IN[1]=values, IN[2]=searchKeys)
# ---------- python_script.python (24 lines) ----------
#Copyright(c) 2016, Dimitar Venkov
# @5devene, dimitar.ven@gmail.com

import clr

def tolist(obj1):
	if hasattr(obj1,"__iter__"): return obj1
	else: return [obj1]

def output1(l1):
	if len(l1) == 1: return l1[0]
	else: return l1

out1, fail = [], []

keys = tolist(IN[0])
elements = tolist(IN[1])
searchVals = tolist(IN[2])
dict1 = dict(zip(keys,elements))
for i in xrange(len(searchVals)):
	if searchVals[i] in dict1: out1.append(dict1[searchVals[i]])
	else: out1.append(fail)

OUT = output1(out1)
# ----------------------------------------
result = Output(python_script)
