# Dynamo custom node Dxf.GetTextsByLayer.dyf (Dynamo 1.3.0.875)
# category: MEPTools.Dxf
# Get texts and text's position by layer names.

# note: AUTHOR + COPYRIGHT
# Copyright 2017 DADRI
# @ChengXin
# note: CONTACT
# chengxin_dl@163.com
# note: PACKAGE NAME
# MEPTools v0.0.1

dxfFilePath = Input(dxfFilePath : var[]..[])
readTexts = Custom[Dxf.ReadTexts](dxfFilePath=dxfFilePath)  # Read texts from importance (.dxf file)
layerName = Input(layerName : var[])
byKeysValues = Custom[Dictionary.ByKeysValues](keys=readTexts.layers, values=readTexts.texts, searchKeys=layerName, lacing=Longest)  # Search value by keys
byKeysValues_2 = Custom[Dictionary.ByKeysValues](keys=readTexts.layers, values=readTexts.textPoints, searchKeys=layerName, lacing=Longest)
isEmpty = List.IsEmpty(lacing=Longest)  # unwired: arg0
code_block = CodeBlock(byKeysValues, byKeysValues_2, isEmpty)
# ---------- code_block.designscript (6 lines) ----------
t1 = {t2, t3};
t4 = DSCore.List.Transpose(t1);
t5 = TrueForAny(t4<1L>, t6<1L>);
t7 = DSCore.List.FilterByBoolMask(t4, t5);
t8 = __TryGetValueFromNestedDictionaries(t7, "in");
t9 = __TryGetValueFromNestedDictionaries(t7, "out");
# ----------------------------------------
firstItem = List.FirstItem(code_block.t9@L2)
textString = Output(firstItem)
lastItem = List.LastItem(code_block.t9@L2)
textPoint = Output(lastItem)
