# Dynamo custom node Dxf.ReadLayers.dyf (Dynamo 1.3.0.875)
# category: MEPTools.Dxf
# Find all the layers in dxf files

# note: CONTACT
# chengxin_dl@163.com

# note: AUTHOR + COPYRIGHT
# Copyright 2017 DADRI
# @ChengXin
# note: PACKAGE NAME
# MEPTools v0.0.1
dxfFilePath = Input(dxfFilePath : var)
readText = File.ReadText(dxfFilePath)
code_block = CodeBlock(t10=readText)
# ---------- code_block.designscript (17 lines) ----------
t8 = "AcDbEntity";
t9 = String.Split(t10, {"ENDSEC"});
t11 = String.Split(t9, {"
"});
t12 = DSCore.List.GetItemAtIndex(t11@-2<1>, 3);
t13 = t12 == "TABLES";
t14 = DSCore.List.FilterByBoolMask(t9, t13);
t15 = __TryGetValueFromNestedDictionaries(t14, "in");
t16 = __TryGetValueFromNestedDictionaries(t14, "out");
t17 = String.Split(t15, {"AcDbLayerTableRecord"});
t18 = String.Split(t17, {"
"});
t19 = Flatten(t18@-2<1>);
t20 = DSCore.List.Deconstruct(t19);
t21 = __TryGetValueFromNestedDictionaries(t20, "first");
t22 = __TryGetValueFromNestedDictionaries(t20, "rest");
t23 = DSCore.List.GetItemAtIndex(t22@-2<1>, 1);
# ----------------------------------------
layers = Output(code_block.t23)  # "layers:string"
