# Dynamo custom node Dxf.ReadTexts.dyf (Dynamo 1.3.0.875)
# category: MEPTools.Dxf
# Read texts from importance (.dxf file)

# note: CONTACT
# chengxin_dl@163.com

# note: AUTHOR + COPYRIGHT
# Copyright 2017 DADRI
# @ChengXin
# note: PACKAGE NAME
# MEPTools v0.0.1
dxfFilePath = Input()
readText = File.ReadText(dxfFilePath)
code_block = CodeBlock(t1=readText)
# ---------- code_block.designscript (17 lines) ----------
t7 = t1;
t6 = String.Split(t7, {"ENDSEC"});
t8 = String.Contains(t6, "ENTITIES", false);
t9 = DSCore.List.FilterByBoolMask(t6, t8);
t10 = __TryGetValueFromNestedDictionaries(t9, "in");
t11 = __TryGetValueFromNestedDictionaries(t9, "out");
textEnt = t10;
t12 = String.Split(textEnt, {"AcDbEntity"});
t13 = String.Split(t12, {"
"});
t14 = Flatten(t13@-2<1>);
t2 = t14;
t3 = DSCore.List.Deconstruct(t2);
t4 = __TryGetValueFromNestedDictionaries(t3, "first");
t5 = __TryGetValueFromNestedDictionaries(t3, "rest");
t61 = DSCore.List.DropEveryNthItem(t5@-2<1>, 2, 0);
t71 = DSCore.List.TakeEveryNthItem(t5@-2<1>, 2, 0);
# ----------------------------------------
code_block_2 = CodeBlock { "100"; }
byKeysValues = Custom[Dictionary.ByKeysValues](keys=code_block.t61, values=code_block.t71, searchKeys=code_block_2)  # Search value by keys
groupByKey = List.GroupByKey(list=code_block.t5, keys=byKeysValues)
code_block_3 = CodeBlock(ententies=groupByKey.groups, keys=groupByKey.unique_keys) { ententies; keys; }
code_block_4 = CodeBlock(t6=code_block_3.keys, t7=code_block_3.ententies)
# ---------- code_block_4.designscript (10 lines) ----------
t5 = t6 == "AcDbText";
t8 = DSCore.List.FilterByBoolMask(t7, t5);
t9 = __TryGetValueFromNestedDictionaries(t8, "in");
t10 = __TryGetValueFromNestedDictionaries(t8, "out");
t11 = DSCore.List.DropEveryNthItem(t9@-2<1>, 2, 0);
t12 = DSCore.List.TakeEveryNthItem(t9@-2<1>, 2, 0);
keys = t11;
values = t12;
t3 = keys;
t4 = values;
# ----------------------------------------
code_block_5 = CodeBlock { "  8"; "  1"; {" 10"," 20"," 30"}; }
byKeysValues_2 = Custom[Dictionary.ByKeysValues](keys=code_block_4.t3, values=code_block_4.t4, searchKeys=code_block_5.out1)
texts = Output(byKeysValues_2)  # "texts : string"
byKeysValues_3 = Custom[Dictionary.ByKeysValues](keys=code_block_4.t3, values=code_block_4.t4, searchKeys=code_block_5.out0)
layers = Output(byKeysValues_3)  # "layers : string"
byKeysValues_4 = Custom[Dictionary.ByKeysValues](keys=code_block_4.t3, values=code_block_4.t4, searchKeys=code_block_5.out2)
code_block_6 = CodeBlock(byKeysValues_4)
# ---------- code_block_6.designscript (8 lines) ----------
t3 = 2;
t4 = DSCore.List.GetItemAtIndex(t5@-2<1>, 0);
t6 = String.ToNumber(t4);
t7 = DSCore.List.GetItemAtIndex(t5@-2<1>, 1);
t8 = String.ToNumber(t7);
t9 = DSCore.List.GetItemAtIndex(t5@-2<1>, 2);
t10 = String.ToNumber(t9);
point1 = Autodesk.Point.ByCoordinates(t6<1L>, t8<1L>, t10<1L>);
# ----------------------------------------
textPoints = Output(code_block_6.point1)  # "textPoints : Points"
