# Dynamo graph examples.dyn (Dynamo 1.3.0.875)

# note: AUTHOR + COPYRIGHT
# Copyright 2017 DADRI
# @ChengXin
# note: CONTACT
# chengxin_dl@163.com

# note: PACKAGE NAME
# MEPTools v0.0.1
file_path = Filename("F:\采暖.dxf")
readTexts = Custom[Dxf.ReadTexts](dxfFilePath=file_path)  # Read texts from importance (.dxf file)
watch = Watch(readTexts.texts)
watch_2 = Watch(readTexts.layers)
watch_3 = Watch(readTexts.textPoints)
readLayers = Custom[Dxf.ReadLayers](dxfFilePath=file_path)  # Find all the layers in dxf files
watch_4 = Watch(readLayers)
file_path_2 = Filename("F:\采暖.dxf")
readLayers_2 = Custom[Dxf.ReadLayers](dxfFilePath=file_path_2)
number_slider = DoubleSlider(3, range=0..10 step 1)
getItemAtIndex = List.GetItemAtIndex(list=readLayers_2, index=number_slider)
getTextsByLayer = Custom[Dxf.GetTextsByLayer](dxfFilePath=file_path_2, layerName=getItemAtIndex)  # Get texts and text's position by layer names.
watch_5 = Watch(getTextsByLayer.textString)
watch_6 = Watch(getTextsByLayer.textPoint)
