# Dynamo custom node Get Rhino Layers.dyf (Dynamo 1.0.0.1180)
# category: Archi-lab_MantisShrimp.Rhinoceros.ReadRhino
# Queries Rhino file and extracts layers.

RhinoFile = Input()
python_script = Python(IN[0]=RhinoFile)
# ---------- python_script.python (30 lines) ----------
# Copyright(c) 2015, Konrad Sobon
# @arch_laboratory, http://archi-lab.net

import clr
import sys

pyt_path = r'C:\Program Files (x86)\IronPython 2.7\Lib'
sys.path.append(pyt_path)

import os
appDataPath = os.getenv('APPDATA')
msPath = appDataPath + r'\Dynamo\Dynamo Revit\1.0\packages\Mantis Shrimp\extra'
if msPath not in sys.path:
	sys.path.append(msPath)
rhDllPath = appDataPath + r'\Dynamo\Dynamo Revit\1.0\packages\Mantis Shrimp\bin\Rhino3dmIO.dll'
clr.AddReferenceToFileAndPath(rhDllPath)

import Rhino as rc

#The inputs to this node will be stored as a list in the IN variable.
dataEnteringNode = IN
rhModel = IN[0]

#extract layer names from 3dm file
rhLayers = []
for i in rhModel.Layers:
	rhLayers.append(i.Name)

#Assign your output to the OUT variable
OUT = rhLayers
# ----------------------------------------
RhinoLayer = Output(python_script)
