# Dynamo custom node Get Rhino Object User Strings.dyf (Dynamo 1.0.0.1180)
# category: Archi-lab_MantisShrimp.Rhinoceros.Properties
# This node will query user strings attached to geometry.

RhinoObject = Input()
python_script = Python(IN[0]=RhinoObject)
# ---------- python_script.python (67 lines) ----------
# Copyright(c) 2015, Konrad Sobon
# @arch_laboratory, http://archi-lab.net

import clr
import sys

pyt_path = r'C:\Program Files (x86)\IronPython 2.7\Lib'
sys.path.append(pyt_path)

import os
appDataPath = os.getenv('APPDATA')
msPath = appDataPath + r'\Dynamo\Dynamo Revit\1.0\packages\Mantis Shrimp\extra'
if msPath not in sys.path:
	sys.path.append(msPath)
rhDllPath = appDataPath + r'\Dynamo\Dynamo Revit\1.0\packages\Mantis Shrimp\bin\Rhino3dmIO.dll'
clr.AddReferenceToFileAndPath(rhDllPath)

import Rhino as rc

#The inputs to this node will be stored as a list in the IN variable.
dataEnteringNode = IN

if isinstance(IN[0], list):
	rhObjects = IN[0]
else:
	rhObjects = [IN[0]]

def GetObjectKeys(obj):
	try:
		keys = []
		if obj.Attributes.HasUserData:
			for i in range(0, obj.Attributes.GetUserStrings().Keys.Count, 1):
				key = obj.Attributes.GetUserStrings().Keys.Item[i]
				keys.append(key)
			return keys
	except:
		pass

def GetObjectValues(obj):
	try:
		values = []
		if obj.Attributes.HasUserData:
			for i in range(0, obj.Attributes.GetUserStrings().Keys.Count, 1):
				key = str(obj.Attributes.GetUserStrings().Keys.Item[i])
				values.append(obj.Attributes.GetUserStrings().Item[key])
			return values
	except:
		pass

def ProcessList(_func, _list):
	return map( lambda x: ProcessList(_func, x) if type(x)==list else _func(x), _list )

#extract user keys
try:
	errorReport = None
	rhKeys = ProcessList(GetObjectKeys, rhObjects)
	rhValues = ProcessList(GetObjectValues, rhObjects)
except:
	# if error accurs anywhere in the process catch it
	import traceback
	errorReport = traceback.format_exc()

#Assign your output to the OUT variable
if errorReport == None:
	OUT = rhKeys, rhValues
else:
	OUT = errorReport
# ----------------------------------------
code_block = CodeBlock(IN=python_script) { IN[0]; IN[1]; }
Key = Output(code_block.out0)
Value = Output(code_block.out1)
