# Dynamo custom node AS3500.1 Probable Simultaneous Demand Calculator.dyf (Dynamo 1.1.0.2094)
# category: MisterMEP
# Takes the fixture's loading units and looks up the probable simultaneous flow figure from Barrie Smith's Blue Book table 48
# Input
# 'IPC to AS3500.1 Multiplier' as Number
# Input 'PSD Parameter' as String

code_block = CodeBlock()
# ---------- code_block.designscript (2 lines) ----------
//this is the multiplier from the pipe sizing example
//IPC to AS/NZS3500.1 = 3.5
# ----------------------------------------
categories = Categories("PipeCurves")
all_elements_of_category = ElementsOfCategory(categories)
PSD_Parameter = Input()
code_block_2 = CodeBlock()
# ---------- code_block_2.designscript (4 lines) ----------
LoadingUnits = {1,2,3,4,5,6,7,8,9,10,11,12,13,14,15,16,17,18,19,20,30,40,50,60,70,80,90,100,110,120,130,140,150,160,170,180,190,200,240,280,320,360,400,440,480,520,560,600,640,680,720,760,800,840,880,920,960,1000,1040,1080,1120,1160,1200,1240,1280,1320,1360,1400,1440,1480,1520,1560,1600,1640,1680,1720,1760,1800,1840,1880,1920,1960,2000,2040,2080,2120,2160,2200,2240,2280,2320,2360,2400,2440,2480,2520,2560,2600,2640,2680,2720,2760,2800,2840,2880,2920,2960,3000,3040,3080,3120,3160,3200,3240,3280,3320,3360,3400,3440,3480,3520,3560,3600,3640,3680,3720,3760,3800,3840,3880,3920,3960,4000};
PSDFlow = {0.1,0.12,0.15,0.18,0.21,0.23,0.24,0.25,0.26,0.27,0.28,0.29,0.3,0.31,0.32,0.33,0.34,0.35,0.36,0.38,0.42,0.45,0.52,0.64,0.73,0.83,0.92,1,1.1,1.2,1.27,1.35,1.42,1.5,1.57,1.65,1.72,1.8,1.97,2.2,2.42,2.57,2.73,2.95,3.1,3.26,3.41,3.48,3.64,3.79,3.86,4.01,4.09,4.17,4.32,4.39,4.47,4.54,4.7,4.77,4.85,5,5.07,5.15,5.23,5.38,5.45,5.53,5.6,5.68,5.76,5.91,5.98,6.06,6.13,6.29,6.36,6.44,6.51,6.66,6.74,6.82,6.89,7.04,7.12,7.19,7.27,7.42,7.5,7.57,7.65,7.8,7.88,7.95,8.03,8.18,8.25,8.33,8.48,8.56,8.63,8.71,8.78,8.94,9.01,9.09,9.24,9.31,9.39,9.47,9.54,9.69,9.77,9.84,9.92,10,10.15,10.22,10.3,10.45,10.53,10.6,10.68,10.83,10.91,10.98,11.06,11.13,11.28,11.36,11.44,11.51,11.66};
//Loading units = AS/NZS3500.1 / Barrie Smith loading unit
//PSDFlow = Barrie Smith probable simulteneous demand flow rate
# ----------------------------------------

# group: Filter Water Pipework
code_block_3 = CodeBlock { "System Classification"; }
getParameterValueByName = Element.GetParameterValueByName(element=all_elements_of_category, parameterName=code_block_3)
code_block_4 = CodeBlock { "Water"; }
contains = String.Contains(str=getParameterValueByName, searchFor=code_block_4)
filterByBoolMask = List.FilterByBoolMask(list=all_elements_of_category, mask=contains)

string = StringInput("Fixture Units")
getParameterValueByName_2 = Element.GetParameterValueByName(element=filterByBoolMask.in, parameterName=string)
IPC_to_AS3500_1_Multiplier = Input()  # "IPC to AS3500.1 Multiplier"
mul = getParameterValueByName_2 * IPC_to_AS3500_1_Multiplier
python_script = Python(IN[0]=code_block_2.LoadingUnits, IN[1]=code_block_2.PSDFlow, IN[2]=mul)
# ---------- python_script.python (25 lines) ----------
import clr
clr.AddReference('ProtoGeometry')
from Autodesk.DesignScript.Geometry import *
#The inputs to this node will be stored as a list in the IN variables.
LoadingUnits = IN[0]
PSDFlow = IN[1]
Key = IN[2]
L = []

#takes the loading units from the input and looks up the table to convert to barrie smith probable simultaneous flow rate
#written by paul.kranz@arcadis.com for ryan.lenihan@aradis.com simpletons AS3500 water sizing method

def vlookup(key, loadingunits, psdflow):

	temp = (min(loadingunits, key=lambda x:abs(x-key)))
	tempindex = loadingunits.index(temp)
	value = psdflow[tempindex]
	return value

for item in range(len(Key)):
	output = vlookup(Key[item], LoadingUnits, PSDFlow)
	L.append(output)

#Assign your output to the OUT variable.
OUT = L
# ----------------------------------------
number = DoubleInput(28.317)
div = python_script / number
setParameterByName = Element.SetParameterByName(element=all_elements_of_category, parameterName=PSD_Parameter, value=div)
code_block_5 = CodeBlock()
# ---------- code_block_5.designscript (2 lines) ----------
//converts imperial to metric because
//revit is counterproductive and runs in imperial
# ----------------------------------------
