# Dynamo custom node Pipe from strings.dyf (Dynamo 1.3.1.1736)
# category: MisterMEP
# Creates pipes from strings, be they detail lines or lines within a DWG file

element = Input(element : Element)
geometry = Element.Geometry(element)
code_block = CodeBlock { "PolyCurve"; }
removeIfNot = RemoveIfNot(geometry, code_block)
curves = PolyCurve.Curves(removeIfNot)
curves_2 = Element.Curves(element, lacing=Longest)
join = List.Join(curves, curves_2)
startPoint = Curve.StartPoint(join)
flatten = Flatten(startPoint)
endPoint = Curve.EndPoint(join)
flatten_2 = Flatten(endPoint)
level = Input(level : Level)
id = Element.Id(level)
python_script = Python(IN[0]=flatten, IN[1]=flatten_2, IN[2]=id)
# ---------- python_script.python (49 lines) ----------
import clr
clr.AddReference("RevitServices")
#import document manager and transaction manager
import RevitServices
from RevitServices.Persistence import DocumentManager
from RevitServices.Transactions import TransactionManager

clr.AddReference('ProtoGeometry')
from Autodesk.DesignScript.Geometry import *

#import revit api
clr.AddReference('RevitAPI')
import Autodesk
from Autodesk.Revit.DB import *

from Autodesk.Revit.DB.Plumbing import *

#import revit nodes
clr.AddReference("RevitNodes")
import Revit
from Autodesk.Revit.DB import *
from Autodesk.Revit.Creation import *
clr.ImportExtensions(Revit.Elements)
clr.ImportExtensions(Revit.GeometryConversion)

doc =  DocumentManager.Instance.CurrentDBDocument

StartXYZ = IN[0]
EndXYZ = IN[1]
levelIdAsInt = IN[2]

levelElementId = Autodesk.Revit.DB.ElementId(levelIdAsInt) # create an element Id from integer

Output = []

TransactionManager.Instance.EnsureInTransaction(doc)
pipeTypeID = FilteredElementCollector(doc).OfClass(PipeType).FirstElement().Id
systemTypeID = FilteredElementCollector(doc).OfClass(PipingSystemType).FirstElement().Id
for index,x in enumerate(StartXYZ):
	StartPoint = StartXYZ[index].ToXyz()
	EndPoint = EndXYZ[index].ToXyz()
	
	pipe = Autodesk.Revit.DB.Plumbing.Pipe.Create(doc, systemTypeID, pipeTypeID, levelElementId, StartPoint, EndPoint)
	
	Output.append(pipe.Id)

TransactionManager.Instance.TransactionTaskDone()

OUT = Output
# ----------------------------------------
OUT = Output(python_script)
