# Dynamo custom node Remove - and _ from String.dyf (Dynamo 1.1.0.2094)
# category: MisterMEP

element = Input(element : Element)
name = Element.Name(element)
code_block = CodeBlock { "_"; }
code_block_2 = CodeBlock { ""; }
replace = String.Replace(str=name, searchFor=code_block, replaceWith=code_block_2, lacing=Longest)
code_block_3 = CodeBlock { "-"; }
replace_2 = String.Replace(str=replace, searchFor=code_block_3, replaceWith=code_block_2)
code_block_4 = CodeBlock { 0; }
code_block_5 = CodeBlock { 3; }
substring = String.Substring(str=replace_2, startIndex=code_block_4, length=code_block_5)
substring_2 = Output(substring)  # "substring"
