# Dynamo custom node Select Water Pipework.dyf (Dynamo 1.1.0.2094)
# category: MisterMEP
# selects pipework from pipecurves category that are part of system classification name contains "water"

categories = Categories("PipeCurves")
all_elements_of_category = ElementsOfCategory(categories)

# group: Filter Water Pipework
code_block = CodeBlock { "System Classification"; }
getParameterValueByName = Element.GetParameterValueByName(element=all_elements_of_category, parameterName=code_block)
code_block_2 = CodeBlock { "Water"; }
contains = String.Contains(str=getParameterValueByName, searchFor=code_block_2)
filterByBoolMask = List.FilterByBoolMask(list=all_elements_of_category, mask=contains)

Water_Pipework = Output(filterByBoolMask.in)
