# Dynamo custom node Set Project Information.dyf (Dynamo 1.3.1.1736)
# category: MisterMEP
# Does as it says

OrganizationName = Input()
OrganisationDescription = Input()
BuildingNumber = Input()
ProjectAuthor = Input()
ProjectDate = Input()
ProjectStatus = Input()
ProjectClient = Input()
ProjectAddress = Input()
ProjectName = Input()
ProjectNumber = Input()
python_script = Python(IN[0]=OrganizationName, IN[1]=OrganisationDescription, IN[2]=BuildingNumber, IN[3]=ProjectAuthor, IN[4]=ProjectDate, IN[5]=ProjectStatus, IN[6]=ProjectClient, IN[7]=ProjectAddress, IN[8]=ProjectName, IN[9]=ProjectNumber)
# ---------- python_script.python (58 lines) ----------
import clr
clr.AddReference("RevitServices")
import RevitServices
from RevitServices.Persistence import DocumentManager
from RevitServices.Transactions import TransactionManager

doc = DocumentManager.Instance.CurrentDBDocument
projinfo = doc.ProjectInformation
#t = Transaction(doc)
#The inputs to this node will be stored as a list in the IN variables.
OrgName = IN[0]
OrgDesc = IN[1]
BuildNumber = IN[2]
ProjAuthor = IN[3]
ProjDate = IN[4]
ProjStat = IN[5]
ProjClient = IN[6]
ProjAddress = IN[7]
ProjName = IN[8]
ProjNumber = IN[9]

TransactionManager.Instance.EnsureInTransaction(doc)

projinfo.OrganizationName = OrgName
projinfo.OrganizationDescription = OrgDesc
projinfo.BuildingName = BuildNumber
# this property seems to be missing in some files - weird...
#try:
projinfo.Author = ProjAuthor
#except:
projinfo.IssueDate = ProjDate
projinfo.Status = ProjStat
projinfo.ClientName = ProjClient
projinfo.Address = ProjAddress
projinfo.Name = ProjName
projinfo.Number = ProjNumber

TransactionManager.Instance.TransactionTaskDone()

elementlist = list()
elementlist.append("DONE!")
elementlist.append(projinfo.OrganizationName)
elementlist.append(projinfo.OrganizationDescription)
elementlist.append(projinfo.BuildingName)
# this property seems to be missing in some files - weird...
try:
	elementlist.append(projinfo.Author)
except:
	elementlist.append(list())
elementlist.append(projinfo.IssueDate)
elementlist.append(projinfo.Status)
elementlist.append(projinfo.ClientName)
elementlist.append(projinfo.Address)
elementlist.append(projinfo.Name)
elementlist.append(projinfo.Number)
OUT = elementlist
#Assign your output to the OUT variable.
#OUT = "done"
# ----------------------------------------
OUT = Output(python_script)
