# Dynamo custom node Join All Intersecting Elements.dyf (Dynamo 1.2.2.373)
# category: PSNodes
# Join All Intersecting Elements

string = StringInput("Completed: ")
list_of_elements = Input()
flatten = Flatten(list_of_elements)
tolerance = CodeBlock { 0; }
get_intersecting_elements_python = Python(IN[0]=flatten, IN[1]=flatten, IN[2]=tolerance)
# ---------- get_intersecting_elements_python.python (60 lines) ----------
#All Credit to Clockwork for this python script
import clr
clr.AddReference('ProtoGeometry')
from Autodesk.DesignScript.Geometry import *
# Import ToDSType(bool) extension method
clr.AddReference("RevitNodes")
import Revit
clr.ImportExtensions(Revit.Elements)
# Import geometry conversion extension methods
clr.ImportExtensions(Revit.GeometryConversion)
# Import DocumentManager and TransactionManager
clr.AddReference("RevitServices")
import RevitServices
from RevitServices.Persistence import DocumentManager
from RevitServices.Transactions import TransactionManager
from System.Collections.Generic import *
# Import RevitAPI
clr.AddReference("RevitAPI")
import Autodesk
from Autodesk.Revit.DB import *
import itertools
import operator

doc = DocumentManager.Instance.CurrentDBDocument
uiapp = DocumentManager.Instance.CurrentUIApplication
app = uiapp.Application
uidoc=DocumentManager.Instance.CurrentUIApplication.ActiveUIDocument
activeV=doc.ActiveView

host = []
finst=[]
finstID=[]
for i in IN[0]:
	host.append(UnwrapElement(i))
for i in IN[1]:
	finst.append(UnwrapElement(i))
for i in IN[1]:
	finstID.append(UnwrapElement(i).Id)	


superset=[]
hloop=[]


for h in host:
	collection = List[ElementId](finstID)
	collector=FilteredElementCollector(doc,collection)
	a=h.BoundingBox[activeV]
	c=Outline (a.Min,a.Max)
	d=BoundingBoxIntersectsFilter(c,float(IN[2]))
	e=collector.WherePasses(d).ToElements()
	setlist=[]
	hostlist=[]
	hostlist.append(h)
	setlist.append(e)
	all_lists = [hostlist,setlist]
	c=reduce(operator.add, all_lists)
	superset.append(c)
		
OUT=superset
# ----------------------------------------
flatten_2 = Flatten()  # unwired: arg0
map = List.Map(list=get_intersecting_elements_python, f_x=flatten_2)
count = List.Count()  # unwired: arg0
map_2 = List.Map(list=map, f_x=count)
code_block = CodeBlock { 1; }
gt = map_2 > code_block
filterByBoolMask = List.FilterByBoolMask(list=map, mask=gt)
count_2 = List.Count()  # unwired: arg0
map_3 = List.Map(list=filterByBoolMask.in, f_x=count_2)
code_block_2 = CodeBlock { 1; }
gt_2 = map_3 > code_block_2
filterByBoolMask_2 = List.FilterByBoolMask(list=filterByBoolMask.in, mask=gt_2)
join_python = Python(IN[0]=filterByBoolMask_2.in)
# ---------- join_python.python (33 lines) ----------
#All credit to archi-lab for this python script
import clr
clr.AddReference('RevitAPI')
from Autodesk.Revit.DB import *
from System.Collections.Generic import *
clr.AddReference("RevitServices")
import RevitServices
from RevitServices.Persistence import DocumentManager
from RevitServices.Transactions import TransactionManager

doc = DocumentManager.Instance.CurrentDBDocument

#The inputs to this node will be stored as a list in the IN variables.
dataEnteringNode = IN

items1 = UnwrapElement(IN[0])


TransactionManager.Instance.EnsureInTransaction(doc)
booleans=[]

for i in range (0,len(items1)):
	for j in range(0,len(items1[i])):
		try:
			JoinGeometryUtils.JoinGeometry(doc,items1[i][0],items1[i][j])
			booleans.append(True)
		except:
			booleans.append(False)

TransactionManager.Instance.TransactionTaskDone()

#Assign your output to the OUT variable.
OUT = booleans
# ----------------------------------------
countTrue = CountTrue(join_python)
number = DoubleInput(0)
eq = countTrue == number
count_3 = Count(filterByBoolMask_2.in)
number_2 = DoubleInput(1)
gt_3 = count_3 > number_2
number_3 = DoubleInput(2)
if_ = If(test=gt_3, true=count_3, false=number_3)
if_2 = If(test=eq, true=number, false=if_)
string_from_object = FromObject(if_2)
string_2 = StringInput(" elements joined.")
concat = String.Concat(string, string_from_object, string_2)
Result = Output(concat)
