# Dynamo graph Example_JoinAllIntersectingElements.dyn (Dynamo 1.2.2.373)

# note: Use a List of Elements
select_model_elements = DSModelElementsSelection()
categories = Categories("StructuralColumns")
all_elements_of_category = ElementsOfCategory(categories)
categories_2 = Categories("Floors")
all_elements_of_category_2 = ElementsOfCategory(categories_2)
categories_3 = Categories("Walls")
all_elements_of_category_3 = ElementsOfCategory(categories_3)
# note: OR Combine Multiple Lists of Elements
create = List.Create(all_elements_of_category, all_elements_of_category_2, all_elements_of_category_3)
# note: 'Result' displays the number of new joins between elements
join_all_intersecting_elements = Custom[Join All Intersecting Elements](list_of_elements=create)  # Join All Intersecting Elements
watch = Watch(join_all_intersecting_elements)
