# Dynamo custom node 3D Views by Workset.dyf (Dynamo 1.1.0.2094)
# category: Modelical.Views
# Makes a new 3D view for each workset in the model, It leaves only one workset visible.

Toggle = Input(Toggle : bool = false)
python_script = Python(IN[0]=Toggle)
# ---------- python_script.python (30 lines) ----------
import clr
clr.AddReference('ProtoGeometry')
from Autodesk.DesignScript.Geometry import *

# Import DocumentManager and TransactionManager
clr.AddReference("RevitServices")
import RevitServices
from RevitServices.Persistence import DocumentManager
from RevitServices.Transactions import TransactionManager

# Import RevitAPI
clr.AddReference("RevitAPI")
import Autodesk
from Autodesk.Revit.DB import *

doc = DocumentManager.Instance.CurrentDBDocument

bool = IN[0]
output = "Set Toggle to TRUE to create new 3D views"

if bool == True:
	wsNames = []

	collector = FilteredWorksetCollector(doc)
	wsList = collector.OfKind(WorksetKind.UserWorkset)
	
	for w in wsList:
		wsNames.append(w.Name)

OUT = wsNames
# ----------------------------------------
code_block = CodeBlock(worksetNames=python_script)
# ---------- code_block.designscript (3 lines) ----------
p1 = Point.ByCoordinates(-30, -30, 30);
p2 = Point.ByCoordinates(0, 0, 0);
axo = AxonometricView.ByEyePointAndTarget(p1, p2, worksetNames);
# ----------------------------------------

# group: Applies only one workset visibility to each view
python_script_2 = Python(IN[0]=Toggle, IN[1]=code_block.axo)
# ---------- python_script_2.python (42 lines) ----------
import clr
clr.AddReference('ProtoGeometry')
from Autodesk.DesignScript.Geometry import *

# Import DocumentManager and TransactionManager
clr.AddReference("RevitServices")
import RevitServices
from RevitServices.Persistence import DocumentManager
from RevitServices.Transactions import TransactionManager

# Import RevitAPI
clr.AddReference("RevitAPI")
import Autodesk
from Autodesk.Revit.DB import *

#The inputs to this node will be stored as a list in the IN variables.
bool = IN[0]
output = "Set Toggle to TRUE to create new 3D views"

if bool:

	views = UnwrapElement(IN[1])
	
	doc = DocumentManager.Instance.CurrentDBDocument
	collector = FilteredWorksetCollector(doc)
	wsIds = collector.OfKind(WorksetKind.UserWorkset).ToWorksetIds()
	
	
	countViews = 0
	for v in views:
		count = 0
		v.Unlock()
		for w in wsIds:
			if countViews == count:
				v.SetWorksetVisibility(w, WorksetVisibility.Visible)
			else:
				v.SetWorksetVisibility(w, WorksetVisibility.Hidden)
			count += 1
		countViews += 1
	output = views
#Assign your output to the OUT variable.
OUT = output
# ----------------------------------------
