# Dynamo custom node AddNextRevision.dyf "Add Next Revision" (Dynamo 1.3.1.1736)
# category: Modelical.Sheets
# Add the next revision to the selected sheets. Switch to manual run to use this node.

# group: sheets
Sheets = Input(Sheets: var[])

# group: doc revisions
python_script = Python()  # unwired: IN[0]
# ---------- python_script.python (56 lines) ----------
# This node has been made by Modelical
# www.modelical.com

import clr
clr.AddReference('ProtoGeometry')
from Autodesk.DesignScript.Geometry import *

#Load Dynamo wrappers
clr.AddReference("RevitNodes")
import Revit
from Revit.Elements import *
clr.ImportExtensions(Revit.GeometryConversion)
clr.ImportExtensions(Revit.Elements)

#Load Revit API
clr.AddReference('RevitAPI')
from Autodesk.Revit.DB import *

#Load document reference
clr.AddReference("RevitServices")
import RevitServices
from RevitServices.Persistence import DocumentManager
from RevitServices.Transactions import TransactionManager

doc = DocumentManager.Instance.CurrentDBDocument
uiapp = DocumentManager.Instance.CurrentUIApplication
app = uiapp.Application

def toList(input):
	if isinstance(input,list) == False:
		return [input]
	else:
		return input

def flatten(x):
    result = []
    for el in x:
        if hasattr(el, "__iter__") and not isinstance(el, basestring):
            result.extend(flatten(el))
        else:
            result.append(el)
    return result

rev = FilteredElementCollector(doc).OfCategory(BuiltInCategory.OST_Revisions).WhereElementIsNotElementType().ToElements()

revName = []	
for e in rev:
	revName.append(e.Name)
	
Sequence = []

for r in rev:
	Sequence.append(r.SequenceNumber)
	

OUT = rev, Sequence
# ----------------------------------------
revisions = CodeBlock(l=python_script) { l[0]; l[1]; }  # "doc.Revisions"

# group: Revisions from sheet + 1
python_script_2 = Python(IN[0]=Sheets, IN[1]=revisions.out0, IN[2]=revisions.out1)
# ---------- python_script_2.python (98 lines) ----------
# This node has been made by Modelical
# www.modelical.com



import clr
clr.AddReference('ProtoGeometry')
from Autodesk.DesignScript.Geometry import *

clr.AddReference('DScoreNodes')
import DSCore
from DSCore import *

#Load Dynamo wrappers
clr.AddReference("RevitNodes")
import Revit
from Revit.Elements import *
clr.ImportExtensions(Revit.GeometryConversion)
clr.ImportExtensions(Revit.Elements)

#Load Revit API
clr.AddReference('RevitAPI')
from Autodesk.Revit.DB import *

#Load document reference
clr.AddReference("RevitServices")
import RevitServices
from RevitServices.Persistence import DocumentManager
from RevitServices.Transactions import TransactionManager

doc = DocumentManager.Instance.CurrentDBDocument
uiapp = DocumentManager.Instance.CurrentUIApplication
app = uiapp.Application

def toList(input):
	if isinstance(input,list) == False:
		return [input]
	else:
		return input

def flatten(x):
    result = []
    for el in x:
        if hasattr(el, "__iter__") and not isinstance(el, basestring):
            result.extend(flatten(el))
        else:
            result.append(el)
    return result



selectedSheets = flatten(toList(IN[0]))
revE = flatten(toList(IN[1]))
revSeqE = flatten(toList(IN[2]))

sheets = UnwrapElement(selectedSheets)


revIDE = []
for s in sheets:
	revIDE.append(s.GetCurrentRevision())

revN = []	
for e in revIDE:
	revN.append(doc.GetElement(e))
	
revSeqN = []
for r in revN:
	try:
		revSeqN.append(str(r.SequenceNumber + 1))
	except:
		revSeqN.append("1")

revision = []

for r in revSeqN:
	rev = []
	count = 0
	flag = 0
	for e in revSeqE:
		if r == str(e):
			rev.append(revE[count])
			flag = 1
			break
		count +=1
	if flag == 0:
		rev.append(revE[len(revSeqE)-1])
	revision.append(rev)
	

revFlat = List.Flatten(revision,2)

revIDN = []
for i in revFlat:
	revIDN.append(i.Id)


OUT = revFlat
# ----------------------------------------

Toggle = Input(Toggle : bool = false)
python_script_3 = Python(IN[0]=Sheets, IN[1]=python_script_2, IN[2]=Toggle)
# ---------- python_script_3.python (81 lines) ----------
# This node has been made by Modelical
# www.modelical.com



import clr
clr.AddReference('ProtoGeometry')
from Autodesk.DesignScript.Geometry import *

clr.AddReference('DScoreNodes')
import DSCore
from DSCore import *

clr.AddReference('System.Core')
from System.Collections.Generic import *

#Load Dynamo wrappers
clr.AddReference("RevitNodes")
import Revit
from Revit.Elements import *
clr.ImportExtensions(Revit.GeometryConversion)
clr.ImportExtensions(Revit.Elements)

#Load Revit API
clr.AddReference('RevitAPI')
from Autodesk.Revit.DB import *

clr.AddReference('RevitAPI')
import Autodesk
from Autodesk.Revit.DB import *

clr.AddReference('RevitAPI')
import Autodesk
from Autodesk.Revit.DB import *
from System.Collections.Generic import *

#Load document reference
clr.AddReference("RevitServices")
import RevitServices
from RevitServices.Persistence import DocumentManager
from RevitServices.Transactions import TransactionManager

doc = DocumentManager.Instance.CurrentDBDocument
uiapp = DocumentManager.Instance.CurrentUIApplication
app = uiapp.Application

def toList(input):
	if isinstance(input,list) == False:
		return [input]
	else:
		return input

def flatten(x):
    result = []
    for el in x:
        if hasattr(el, "__iter__") and not isinstance(el, basestring):
            result.extend(flatten(el))
        else:
            result.append(el)
    return result


selectedSheets = flatten(toList(IN[0]))
revision = flatten(toList(IN[1]))
bool = IN[2]

sheets = UnwrapElement(selectedSheets)
rev = UnwrapElement(revision)

TransactionManager.Instance.EnsureInTransaction(doc)
if bool == True:
	count = 0
	for s in sheets:
		revOnSheet = List[Autodesk.Revit.DB.ElementId]()	
		revOnSheet.Add(rev[count].Id)
		s.SetAdditionalRevisionIds(revOnSheet)
		revOnSheet.Clear()
		count +=1
TransactionManager.Instance.TransactionTaskDone()

OUT = sheets, str('It just works on MANUAL mode')
# ----------------------------------------
sheets = CodeBlock(l=python_script_3) { l[0]; l[1]; }
Sheets_2 = Output(sheets.out0)  # "Sheets"
info = Output(sheets.out1)
