# Dynamo custom node Angle Between Vectors.dyf (Dynamo 1.2.1.3083)
# category: Modelical.Geometry
# Returns the angle that forms a vector with another reference vector, clockwise and counterclockwise. The vectors are calculated in the XY plane.

RefVector = Input()
Vector = Input()
python_script = Python(IN[0]=RefVector, IN[1]=Vector)
# ---------- python_script.python (51 lines) ----------
# This node has been made by Modelical
# www.modelical.com

import clr
clr.AddReference('ProtoGeometry')
from Autodesk.DesignScript.Geometry import *

from math import *

def toList(input):
	if isinstance(input,list) == False:
		return [input]
	else:
		return input

vec1 = toList(IN[0])
vec2 = toList(IN[1])


def length(v):
    return sqrt(v.X**2 + v.Y**2)

def dot_product(v,w):
   return v.X * w.X + v.Y * w.Y

def determinant(v,w):
   return v.X*w.Y-v.Y*w.X

def inner_angle(v,w):
   cosx=dot_product(v,w)/(length(v)*length(w))
   rad=acos(cosx) # in radians
   return rad*180/pi # returns degrees

def angle_clockwise(A, B):
    inner=inner_angle(A,B)
    det = determinant(A,B)
    if det<0:
        return round(inner,5)
    else:
        return round(360-inner,5)

angles = []
counterClockAngles = []

for v in vec2:
	a = angle_clockwise(vec1[0], v)
	angles.append(a)
	counterClockAngles.append(360-a)


OUT = angles, counterClockAngles
# ----------------------------------------
code_block = CodeBlock(l=python_script) { l[0]; l[1]; }
Clockwise = Output(code_block.out0)
Counterclockwise = Output(code_block.out1)
