# Dynamo custom node Apply ViewTemplate.dyf (Dynamo 1.1.0.2094)
# category: Modelical.Views
# Apply ViewTemplate(s) to selected view(s).

Views = Input()
list_assurance = Python(IN[0]=Views)
# ---------- list_assurance.python (13 lines) ----------
import clr
clr.AddReference('ProtoGeometry')
from Autodesk.DesignScript.Geometry import *
#The inputs to this node will be stored as a list in the IN variables.
input = IN[0]

if isinstance(input,list) == False:
	elements = [input]
else:
	elements = input

#Assign your output to the OUT variable.
OUT = elements
# ----------------------------------------
flatten = Flatten(list_assurance)
TempNames = Input()
list_assurance_2 = Python(IN[0]=TempNames)  # same code as list_assurance
flatten_2 = Flatten(list_assurance_2)
python_script = Python(IN[0]=flatten, IN[1]=flatten_2)
# ---------- python_script.python (46 lines) ----------
import clr
clr.AddReference('ProtoGeometry')
from Autodesk.DesignScript.Geometry import *

# Import DocumentManager and TransactionManager
clr.AddReference("RevitServices")
import RevitServices
from RevitServices.Persistence import DocumentManager
from RevitServices.Transactions import TransactionManager

# Import RevitAPI
clr.AddReference("RevitAPI")
import Autodesk
from Autodesk.Revit.DB import *

doc = DocumentManager.Instance.CurrentDBDocument

#The inputs to this node will be stored as a list in the IN variable.
views = UnwrapElement(IN[0])
viewTempName = IN[1]
templateList = []

collector = FilteredElementCollector(doc).OfClass(View)
for j in viewTempName:
	for i in collector:
		if i.IsTemplate == True and i.Name == j:
			templateList.append(i)

TransactionManager.Instance.EnsureInTransaction(doc)
h = 0

if len(templateList) == 1 and len(views) > 1:
	for i in views:
		TempTemplate = templateList[0]
		i.ViewTemplateId = TempTemplate.Id

else:
	for i in views:
		TempTemplate = templateList[h]
		i.ViewTemplateId = TempTemplate.Id
		h=h+1

TransactionManager.Instance.TransactionTaskDone()

#Assign your output to the OUT variable
OUT = views
# ----------------------------------------
Views_2 = Output(python_script)  # "Views"
