# Dynamo custom node Change duct_pipe fitting level.dyf (Dynamo 1.3.0.875)
# category: Modelical.MEP
# Change the level of a pipe/duct fitting(s) to another one, modifying also its offset value.

Duct_Pipe_fitting_s = Input()  # "Duct/Pipe fitting(s)"
end_Level_s = Input()  # "end Level(s)"
python_script = Python(IN[0]=Duct_Pipe_fitting_s, IN[1]=end_Level_s)
# ---------- python_script.python (78 lines) ----------
# This node has been made by Modelical
# www.modelical.com

import clr
clr.AddReference('ProtoGeometry')
from Autodesk.DesignScript.Geometry import *

#Load Dynamo wrappers
clr.AddReference("RevitNodes")
import Revit
from Revit.Elements import *
clr.ImportExtensions(Revit.GeometryConversion)
clr.ImportExtensions(Revit.Elements)

#Load Revit API
clr.AddReference('RevitAPI')
from Autodesk.Revit.DB import *
import Autodesk

#Load document reference
clr.AddReference("RevitServices")
import RevitServices
from RevitServices.Persistence import DocumentManager
from RevitServices.Transactions import TransactionManager

doc = DocumentManager.Instance.CurrentDBDocument
uiapp = DocumentManager.Instance.CurrentUIApplication
app = uiapp.Application

def toList(input):
	if isinstance(input,list) == False:
		return [input]
	else:
		return input

def flatten(x):
    result = []
    for el in x:
        if hasattr(el, "__iter__") and not isinstance(el, basestring):
            result.extend(flatten(el))
        else:
            result.append(el)
    return result

fittings = UnwrapElement(flatten(toList(IN[0])))
destinationLevels = UnwrapElement(flatten(toList(IN[1])))

TransactionManager.Instance.EnsureInTransaction(doc)

if len(destinationLevels) == 1:
	for f in fittings:
		startLevelId = f.get_Parameter(BuiltInParameter.FAMILY_LEVEL_PARAM).AsElementId()
		startLevelElevation = doc.GetElement(startLevelId).Elevation
		startOffset = f.get_Parameter(BuiltInParameter.INSTANCE_FREE_HOST_OFFSET_PARAM).AsDouble()
		endLevelElevation = destinationLevels[0].Elevation
		endOffset = startLevelElevation + startOffset - endLevelElevation
		endLevelId = destinationLevels[0].Id
		f.get_Parameter(BuiltInParameter.INSTANCE_FREE_HOST_OFFSET_PARAM).Set(endOffset)
		f.get_Parameter(BuiltInParameter.FAMILY_LEVEL_PARAM).Set(endLevelId)
		f.ToDSType(True)

if len(destinationLevels) > 1:
	i = 0
	for f in fittings:
		startLevelId = f.get_Parameter(BuiltInParameter.FAMILY_LEVEL_PARAM).AsElementId()
		startLevelElevation = doc.GetElement(startLevelId).Elevation
		startOffset = f.get_Parameter(BuiltInParameter.INSTANCE_FREE_HOST_OFFSET_PARAM).AsDouble()
		endLevelElevation = destinationLevels[i].Elevation
		endOffset = startLevelElevation + startOffset - endLevelElevation
		endLevelId = destinationLevels[i].Id
		f.get_Parameter(BuiltInParameter.INSTANCE_FREE_HOST_OFFSET_PARAM).Set(endOffset)
		f.get_Parameter(BuiltInParameter.FAMILY_LEVEL_PARAM).Set(endLevelId)
		f.ToDSType(True)
		i += 1

TransactionManager.Instance.TransactionTaskDone()

OUT = fittings
# ----------------------------------------
fittings = Output(python_script)
