# Dynamo custom node Cleanup.DeleteUnusedViewTemplates.dyf (Dynamo 2.12.0.5650)
# category: Modelical.Actions
# This node deletes all unused view templates in the project file.

bool = Input(_bool: bool = false)  # Set Toggle to TRUE to delete unused View Templates
python_script = Python(IN[0]=bool)  # IronPython2
# ---------- python_script.python (89 lines) ----------
# This node has been made by Modelical
# www.modelical.com

import clr
clr.AddReference("ProtoGeometry")
from Autodesk.DesignScript.Geometry import *


clr.AddReference("DSCoreNodes")
from DSCore import *


clr.AddReference("RevitAPI")
from Autodesk.Revit.DB import *
from Autodesk.Revit.DB.Structure import *

clr.AddReference("RevitAPIUI")
from Autodesk.Revit.UI import *

clr.AddReference("RevitNodes")
import Revit
clr.ImportExtensions(Revit.GeometryConversion)
clr.ImportExtensions(Revit.Elements)


clr.AddReference("RevitServices")
import RevitServices
from RevitServices.Persistence import DocumentManager
from RevitServices.Transactions import TransactionManager

uidoc = DocumentManager.Instance.CurrentUIApplication
doc = DocumentManager.Instance.CurrentDBDocument
app = uidoc.Application


import sys
sys.path.append(r"C:\Program Files (x86)\IronPython 2.7\Lib")
# Function Helpers
def Feet2m(value):
	return value * 0.3048

def toList(input):
    """Return iterable if available, a list of 1 otherwise"""
    if hasattr(input, "__iter__") and not isinstance(input, basestring):
        return input
    else:
        return [input]

def flatten(x):
    result = []
    for el in x:
        if hasattr(el, "__iter__") and not isinstance(el, basestring):
            result.extend(flatten(el))
        else:
            result.append(el)
    return result

# Logic starts here
bool = IN[0]

if bool:
	views=FilteredElementCollector(doc).OfCategory(BuiltInCategory.OST_Views)
	names=[]
	allVTemp=[]
	usedVTemp=[]
	
	count=0	
	for v in views:
		if v.IsTemplate:
			allVTemp.append(v.Id)
		else:
			if v.ViewTemplateId.IntegerValue != -1:
				usedVTemp.append(v.ViewTemplateId)
				
				
	TransactionManager.Instance.EnsureInTransaction(doc)
	for vTemp in allVTemp:
		if vTemp not in usedVTemp:
			doc.Delete(vTemp)
			count+=1
		
	TransactionManager.Instance.TransactionTaskDone()
	
	
	# Output
	
	OUT=str(count)+" template/s have been deleted from Revit"
else:
	OUT="Set Toggle to TRUE to delete unused View Templates"
# ----------------------------------------
Number_of_deleted_View_Templates__info = Output(python_script)  # "/*Number of deleted View Templates*/ _info"
