# Dynamo custom node Delete LinePatterns.dyf (Dynamo 1.3.1.1736)
# category: Modelical.Cleanup
# Delete all the imported Line Patterns from CAD files.

Toggle = Input(Toggle : bool = false)
python_script = Python(IN[0]=Toggle)
# ---------- python_script.python (68 lines) ----------
# This node has been made by Modelical
# www.modelical.com

import clr
clr.AddReference('ProtoGeometry')
from Autodesk.DesignScript.Geometry import *

#Load Dynamo wrappers
clr.AddReference("RevitNodes")
import Revit
from Revit.Elements import *
clr.ImportExtensions(Revit.GeometryConversion)
clr.ImportExtensions(Revit.Elements)

#Load Revit API
clr.AddReference('RevitAPI')
from Autodesk.Revit.DB import *
import Autodesk

#Load document reference
clr.AddReference("RevitServices")
import RevitServices
from RevitServices.Persistence import DocumentManager
from RevitServices.Transactions import TransactionManager

doc = DocumentManager.Instance.CurrentDBDocument
uiapp = DocumentManager.Instance.CurrentUIApplication
app = uiapp.Application

def toList(input):
	if isinstance(input,list) == False:
		return [input]
	else:
		return input

def flatten(x):
    result = []
    for el in x:
        if hasattr(el, "__iter__") and not isinstance(el, basestring):
            result.extend(flatten(el))
        else:
            result.append(el)
    return result

bool = IN[0]
output = "Set Toggle to TRUE to delete imported Line Patterns"

collector = FilteredElementCollector(doc)
allLinePatterns = collector.OfClass(LinePatternElement).ToElements()

linePatternsNames = UnwrapElement(allLinePatterns)

delLinePatternsId = []

if bool == True:
	for l in linePatternsNames:
		if l.Name.startswith("IMPORT"):
			delLinePatternsId.append(l.Id)
	output = str(len(delLinePatternsId)) + " Line Patterns have been deleted"

	TransactionManager.Instance.EnsureInTransaction(doc)

	for l in delLinePatternsId:
		doc.Delete(l)

	TransactionManager.Instance.TransactionTaskDone()

OUT = output
# ----------------------------------------
out = Output(python_script)
