# Dynamo custom node Delete Unused Filters.dyf (Dynamo 1.2.1.3083)
# category: Modelical.Cleanup
# Delete all unused filters in your project file

Toggle = Input(Toggle : bool = false)
python_script = Python(IN[0]=Toggle)
# ---------- python_script.python (80 lines) ----------
#Note: The methods used in this script has been taken from Paul Wintour's BVN package and reused to achieve the purpose oh the same. https://parametricmonkey.com/2016/03/09/get-unused-filters/

import clr
clr.AddReference('ProtoGeometry')
from Autodesk.DesignScript.Geometry import *

clr.AddReference("System.Core")
import System.Linq
clr.ImportExtensions(System.Linq)

clr.AddReference("RevitAPI")
import Autodesk.Revit
from Autodesk.Revit.Exceptions import InvalidOperationException
from Autodesk.Revit.DB import *
from Autodesk.Revit.DB import ElementId
from System.Collections.Generic import *

# Import ToDSType(bool) extension method
clr.AddReference("RevitNodes")
import Revit
clr.ImportExtensions(Revit.Elements)

# Import DocumentManager
clr.AddReference("RevitServices")
import RevitServices
from RevitServices.Persistence import DocumentManager
from RevitServices.Transactions import TransactionManager
from RevitServices.Persistence import DocumentManager

def GetFilterIds(view):
  filterIds = None
  try:
    filterIds = view.GetFilters()
  except InvalidOperationException, e:
    filterIds = None
  return filterIds

def GetUsedFilterIds(doc):
  views = FilteredElementCollector(doc).OfClass(View).ToElements()
  usedFilterIds = []
  for view in views:
    viewFilterIds = []
    try:
      viewFilterIds = view.GetFilters()
    except InvalidOperationException, e:
      pass # this exception happens when a view doesn't support filters
    usedFilterIds.extend(viewFilterIds)
  return usedFilterIds

def GetUnusedFilters(doc):
  usedFilterIds = GetUsedFilterIds(doc).ToList[ElementId]()
  unusedFilters = FilteredElementCollector(doc).OfClass(ParameterFilterElement).Excluding(usedFilterIds).ToElements()
  return list(f.ToDSType(True) for f in unusedFilters)

#The inputs to this node will be stored as a list in the IN variables.

bool = IN[0]
output = "Set Toggle to TRUE to delete unused filters"

doc = DocumentManager.Instance.CurrentDBDocument

filters = GetUnusedFilters(doc)
filters2 = UnwrapElement(filters)
filtersID = []
filtersNames = []

if bool == True:
	for f in filters2:
		filtersID.append(f.Id)

	TransactionManager.Instance.EnsureInTransaction(doc)

	for f in filtersID:
		filtersNames.append(doc.GetElement(f).Name)
		doc.Delete(f)

	TransactionManager.Instance.TransactionTaskDone()
	output = filtersNames
#Assign your output to the OUT variable.
OUT = output
# ----------------------------------------
out = Output(python_script)
