# Dynamo custom node Delete Unused ViewTemplates.dyf (Dynamo 1.3.0.875)
# category: Modelical.Cleanup
# Delete all unused ViewTemplates in your file, except for 3D view templates, as they cannot be converted to work with Dynamo yet.

Toggle = Input(Toggle : bool = false)
python_script = Python(IN[0]=Toggle)
# ---------- python_script.python (90 lines) ----------
# This node has been made by Modelical
# www.modelical.com

import clr
clr.AddReference('RevitAPI')
from Autodesk.Revit.DB import *
import Autodesk

clr.AddReference("RevitServices")
import RevitServices
from RevitServices.Persistence import DocumentManager
from RevitServices.Transactions import TransactionManager
from RevitServices.Persistence import DocumentManager

#The inputs to this node will be stored as a list in the IN variables.

bool = IN[0]
output = "Set Toggle to TRUE to delete unused View Templates"

doc = DocumentManager.Instance.CurrentDBDocument
collector = FilteredElementCollector(doc)
allviews = collector.OfClass(View).ToElements()
viewlist = []

for v in allviews:
	if v.ViewType == ViewType.ThreeD:
		if not(v.IsTemplate):
			viewlist.append(v)
	else:
		viewlist.append(v)

views = UnwrapElement(viewlist)

viewTemplates = []
for v in views:
	if v.IsTemplate:
		viewTemplates.append(v)

usedTemplates = []
for v in views:
	if v.ViewTemplateId.IntegerValue != -1:
		usedTemplates.append(v.Document.GetElement(v.ViewTemplateId))

uniqueUsedTemplates = []

if len(usedTemplates) != 0:
	uniqueUsedTemplates.append(usedTemplates[0])
	for used in usedTemplates:
		buffer = False
		for unique in uniqueUsedTemplates:
			if used.Name == unique.Name:
				buffer = False
				break
			else:
				buffer = True
		if buffer:
			uniqueUsedTemplates.append(used)

indexes = []
i = 0
for v in viewTemplates:
	for u in usedTemplates:
		if u.Name == v.Name:
			indexes.append(i)
			break
	i = i + 1

indexes.reverse()

for i in indexes:
	viewTemplates.pop(i)

viewTemplatesID = []
viewTempNames = []

if bool == True:
	for v in viewTemplates:
		viewTemplatesID.append(v.Id)

	TransactionManager.Instance.EnsureInTransaction(doc)

	for v in viewTemplatesID:
		viewTempNames.append(doc.GetElement(v).Name)
		doc.Delete(v)

	TransactionManager.Instance.TransactionTaskDone()
	output = viewTempNames


OUT = output
# ----------------------------------------
out = Output(python_script)
