# Dynamo custom node Disable Analytical Model.dyf (Dynamo 1.1.0.2094)
# category: Modelical.Structure
# Enable or disable the analytical model (True = Disable | False = Enable)

TrueFalse = Input(TrueFalse : bool)
code_block = CodeBlock { 0; 1; }
if_ = If(test=TrueFalse, true=code_block.out0, false=code_block.out1)

# group: Structural Foundation
categories = Categories("StructuralFoundation")
all_elements_of_category = ElementsOfCategory(categories)
code_block_2 = CodeBlock { "Enable Analytical Model"; }
setParameterByName = Element.SetParameterByName(element=all_elements_of_category, parameterName=code_block_2, value=if_)

# group: Structural Framing
categories_2 = Categories("StructuralFraming")
all_elements_of_category_2 = ElementsOfCategory(categories_2)
code_block_3 = CodeBlock { "Enable Analytical Model"; }
setParameterByName_2 = Element.SetParameterByName(element=all_elements_of_category_2, parameterName=code_block_3, value=if_)

# group: Structural columns
categories_3 = Categories("StructuralColumns")
all_elements_of_category_3 = ElementsOfCategory(categories_3)
code_block_4 = CodeBlock { "Enable Analytical Model"; }
setParameterByName_3 = Element.SetParameterByName(element=all_elements_of_category_3, parameterName=code_block_4, value=if_)

code_block_5 = CodeBlock { "Disabled"; "Enabled"; }
if_2 = If(test=TrueFalse, true=code_block_5.out0, false=code_block_5.out1)
State = Output(if_2)

# group: Walls
categories_4 = Categories("Walls")
all_elements_of_category_4 = ElementsOfCategory(categories_4)
code_block_6 = CodeBlock { "Enable Analytical Model"; }
setParameterByName_4 = Element.SetParameterByName(element=all_elements_of_category_4, parameterName=code_block_6, value=if_)

# group: Floors
categories_5 = Categories("Floors")
all_elements_of_category_5 = ElementsOfCategory(categories_5)
code_block_7 = CodeBlock { "Enable Analytical Model"; }
setParameterByName_5 = Element.SetParameterByName(element=all_elements_of_category_5, parameterName=code_block_7, value=if_)
