# Dynamo custom node DisallowAllow Join in STR Framing.dyf "Disallow/Allow Join in STR Framing" (Dynamo 1.3.1.1736)
# category: Modelical.Structure
# Disallow or allow join condition at Structural Framing ends (True = Disallow | False = Allow)

strFraming = Input()
TrueFalse = Input(TrueFalse : bool)
python_script = Python(IN[0]=strFraming, IN[1]=TrueFalse)
# ---------- python_script.python (63 lines) ----------
# This node has been made by Modelical
# www.modelical.com

import clr
clr.AddReference('ProtoGeometry')
from Autodesk.DesignScript.Geometry import *

#Load Dynamo wrappers
clr.AddReference("RevitNodes")
import Revit
from Revit.Elements import *
clr.ImportExtensions(Revit.GeometryConversion)
clr.ImportExtensions(Revit.Elements)

#Load Revit API
clr.AddReference('RevitAPI')
from Autodesk.Revit.DB import *
from Autodesk.Revit.DB.Structure import *
import Autodesk

#Load document reference
clr.AddReference("RevitServices")
import RevitServices
from RevitServices.Persistence import DocumentManager
from RevitServices.Transactions import TransactionManager

doc = DocumentManager.Instance.CurrentDBDocument
uiapp = DocumentManager.Instance.CurrentUIApplication
app = uiapp.Application

def toList(input):
	if isinstance(input,list) == False:
		return [input]
	else:
		return input

def flatten(x):
    result = []
    for el in x:
        if hasattr(el, "__iter__") and not isinstance(el, basestring):
            result.extend(flatten(el))
        else:
            result.append(el)
    return result

strFraming = flatten(toList(UnwrapElement(IN[0])))
disallowed = IN[1]

if disallowed:
	TransactionManager.Instance.EnsureInTransaction(doc)
	for strF in strFraming:
		StructuralFramingUtils.DisallowJoinAtEnd(strF,0)
		StructuralFramingUtils.DisallowJoinAtEnd(strF,1)
	TransactionManager.Instance.TransactionTaskDone()

else:
	TransactionManager.Instance.EnsureInTransaction(doc)
	for strF in strFraming:
		StructuralFramingUtils.AllowJoinAtEnd(strF,0)
		StructuralFramingUtils.AllowJoinAtEnd(strF,1)
	TransactionManager.Instance.TransactionTaskDone()

OUT = strFraming
# ----------------------------------------
strFraming_2 = Output(python_script)  # "strFraming"
code_block = CodeBlock { "Disallowed"; "Allowed"; }
if_ = If(test=TrueFalse, true=code_block.out0, false=code_block.out1)
State = Output(if_)
