# Dynamo custom node Duplicate view with ViewTemplate.dyf (Dynamo 1.1.0.2094)
# category: Modelical.Views
# Duplicate selected views as many times as View Template names and apply them.

Views = Input()
list_assurance = Python(IN[0]=Views)
# ---------- list_assurance.python (13 lines) ----------
import clr
clr.AddReference('ProtoGeometry')
from Autodesk.DesignScript.Geometry import *
#The inputs to this node will be stored as a list in the IN variables.
input = IN[0]

if isinstance(input,list) == False:
	elements = [input]
else:
	elements = input

#Assign your output to the OUT variable.
OUT = elements
# ----------------------------------------
flatten = Flatten(list_assurance)
TempNames = Input()
list_assurance_2 = Python(IN[0]=TempNames)  # same code as list_assurance
flatten_2 = Flatten(list_assurance_2)
count = Count(flatten_2)
ofRepeatedItem = List.OfRepeatedItem(item=flatten, amount=count)
transpose = List.Transpose(ofRepeatedItem)
flatten_3 = Flatten(transpose)
python_script = Python(IN[0]=flatten_3)
# ---------- python_script.python (22 lines) ----------
import clr
clr.AddReference('RevitAPI')
from Autodesk.Revit.DB import *
import Autodesk

clr.AddReference("RevitServices")
import RevitServices
from RevitServices.Persistence import DocumentManager
from RevitServices.Transactions import TransactionManager

doc = DocumentManager.Instance.CurrentDBDocument
views = UnwrapElement(IN[0])
elementlist = list()
dupopt = Autodesk.Revit.DB.ViewDuplicateOption.Duplicate

TransactionManager.Instance.EnsureInTransaction(doc)
for view in views:
	newview = view.Duplicate(dupopt)
	elementlist.append(doc.GetElement(newview))
TransactionManager.Instance.TransactionTaskDone()
	
OUT = elementlist
# ----------------------------------------
count_2 = Count(flatten)
ofRepeatedItem_2 = List.OfRepeatedItem(item=flatten_2, amount=count_2)
flatten_4 = Flatten(ofRepeatedItem_2)
python_script_2 = Python(IN[0]=python_script, IN[1]=flatten_4)
# ---------- python_script_2.python (39 lines) ----------
import clr
clr.AddReference('ProtoGeometry')
from Autodesk.DesignScript.Geometry import *

# Import DocumentManager and TransactionManager
clr.AddReference("RevitServices")
import RevitServices
from RevitServices.Persistence import DocumentManager
from RevitServices.Transactions import TransactionManager

# Import RevitAPI
clr.AddReference("RevitAPI")
import Autodesk
from Autodesk.Revit.DB import *

doc = DocumentManager.Instance.CurrentDBDocument

#The inputs to this node will be stored as a list in the IN variable.
views = UnwrapElement(IN[0])
viewTempName = IN[1]
templateList = []

collector = FilteredElementCollector(doc).OfClass(View)
for j in viewTempName:
	for i in collector:
		if i.IsTemplate == True and i.Name == j:
			templateList.append(i)

TransactionManager.Instance.EnsureInTransaction(doc)
h = 0
for i in views:
	TempTemplate = templateList[h]
	i.ViewTemplateId = TempTemplate.Id
	h=h+1

TransactionManager.Instance.TransactionTaskDone()

#Assign your output to the OUT variable
OUT = views
# ----------------------------------------
code_block = CodeBlock { "View Name"; }
getParameterValueByName = Element.GetParameterValueByName(element=flatten_3, parameterName=code_block)
code_block_2 = CodeBlock(a=getParameterValueByName, b=flatten_4) { a+"_"+b; }
setParameterByName = Element.SetParameterByName(element=python_script_2, parameterName=code_block, value=code_block_2)
Views_2 = Output(setParameterByName)  # "Views"
