# Dynamo custom node Element.CheckoutStatus.dyf (Dynamo 2.12.0.5650)
# category: Modelical.Elements.Query
# This node gets information 'About Creator:', 'Last update in central performed by' and 'Current Owner:' of an element in the active project file.

elements = Input(_elements: var[]..[])  # Element(s) to ask about creator, last update in central and current owner
python_script = Python(IN[0]=elements)  # IronPython2
# ---------- python_script.python (77 lines) ----------
# This bit is default. It is always used.
# It connects with DesignScript and Dynamo internals and
# Enable Python support and load DesignScript library.
import clr
clr.AddReference("ProtoGeometry")
from Autodesk.DesignScript.Geometry import *

# This import let's us call / use Dynamo nodes from Python code
clr.AddReference("DSCoreNodes")
from DSCore import *
# General API and User Interface API DLL

clr.AddReference("RevitAPI")
from Autodesk.Revit.DB import *
from Autodesk.Revit.DB.Structure import *

clr.AddReference("RevitAPIUI")
from Autodesk.Revit.UI import *

clr.AddReference("RevitNodes")
import Revit
clr.ImportExtensions(Revit.GeometryConversion)
clr.ImportExtensions(Revit.Elements)
# This bit is needed to access revit documents (project and families) 
# and to use Transactions (when we need to WRITE data to the Revit database)
clr.AddReference("RevitServices")
import RevitServices
from RevitServices.Persistence import DocumentManager
from RevitServices.Transactions import TransactionManager

uidoc = DocumentManager.Instance.CurrentUIApplication
doc = DocumentManager.Instance.CurrentDBDocument
app = uidoc.Application

# To be able to import Python Standard Library modules, we need to locate them
import sys
sys.path.append(r"C:\Program Files (x86)\IronPython 2.7\Lib")
# Function Helpers
def Feet2m(value):
	return value * 0.3048

def toList(input):
    """Return iterable if available, a list of 1 otherwise"""
    if hasattr(input, "__iter__") and not isinstance(input, basestring):
        return iter(input)
    else:
        return [input]

def flatten(x):
    result = []
    for el in x:
        if hasattr(el, "__iter__") and not isinstance(el, basestring):
            result.extend(flatten(el))
        else:
            result.append(el)
    return result

# Logic starts here
elements = toList(UnwrapElement(IN[0]))
fList=[]
for e in elements:
	creator= WorksharingUtils.GetWorksharingTooltipInfo(doc,e.Id).Creator +" is the creator "
	lastChageBy=WorksharingUtils.GetWorksharingTooltipInfo(doc,e.Id).LastChangedBy+" performed the last change"
	
	if WorksharingUtils.GetWorksharingTooltipInfo(doc,e.Id).Owner != "":
		owner = WorksharingUtils.GetWorksharingTooltipInfo(doc,e.Id).Owner+ " is the owner"
	else:
		owner = "It's free"
		
	
	fList.append([e,creator,lastChageBy,owner])
# Transactions
TransactionManager.Instance.EnsureInTransaction(doc)
# Your code
TransactionManager.Instance.TransactionTaskDone()
# Output
OUT =fList
# ----------------------------------------
info = Output(python_script)  # "_info"
