# Dynamo custom node Element.OverrideColorInViewFull.dyf (Dynamo 2.12.0.5650)
# category: Modelical.Elements.Actions
# This node modifies the visualization of the elements in the active view by selecting color and fill pattern. Solid fill pattern will be applied by default.

elements = Input(_elements: var[]..[])  # Elements to override
colors = Input(_colors: DSCore.Color[]..[])  # Colors to be applied. You can use Color Range component
fillPatternName = Input(_fillPatternName: string[]..[])  # Fill Pattern name (String).Solid Fill will be applied by default
reset = Input(_reset: bool = false)  # If true, it will remove color overrides
python_script = Python(IN[0]=elements, IN[1]=colors, IN[2]=fillPatternName, IN[3]=reset)  # IronPython2
# ---------- python_script.python (112 lines) ----------
# This node has been made by Modelical
# www.modelical.com

import clr
clr.AddReference('ProtoGeometry')
from Autodesk.DesignScript.Geometry import *

clr.AddReference("RevitNodes")
import Revit
clr.ImportExtensions(Revit.Elements)

clr.AddReference("RevitServices")
import RevitServices
from RevitServices.Persistence import DocumentManager
from RevitServices.Transactions import TransactionManager

from System.Collections.Generic import *

clr.AddReference("RevitAPI")
import Autodesk
from Autodesk.Revit.DB import *

doc = DocumentManager.Instance.CurrentDBDocument
uiapp = DocumentManager.Instance.CurrentUIApplication
app = uiapp.Application
version = app.VersionNumber

def toList(input):
    """Return list if available, a list of 1 otherwise"""
    if hasattr(input, "__iter__") and not isinstance(input, basestring):
        return input
    else:
        return [input]

def flatten(x):
    result = []
    for el in x:
        if hasattr(el, "__iter__") and not isinstance(el, basestring):
            result.extend(flatten(el))
        else:
            result.append(el)
    return result

input = flatten(toList(IN[0]))
dynColor = flatten(toList(IN[1]))
name = IN[2]
bool = IN[3]	

elements = []
for i in input:
	elements.append(UnwrapElement(i))

if bool:
	view = doc.ActiveView
	override = OverrideGraphicSettings()
	
	TransactionManager.Instance.EnsureInTransaction(doc)
	for e in elements:
		view.SetElementOverrides(e.Id, override)
	TransactionManager.Instance.TransactionTaskDone()
	OUT = elements

else:
	fillPatterns = FilteredElementCollector(doc).OfClass(FillPatternElement).ToElements()
	for f in fillPatterns:
		if f.GetFillPattern().IsSolidFill:
			fillPat = f
			break
	
	graphSettings = Autodesk.Revit.DB.OverrideGraphicSettings()
	color = []
	for d in dynColor:
		color.append(Autodesk.Revit.DB.Color(d.Red, d.Green, d.Blue))

	fillPatDraft = FillPatternElement.GetFillPatternElementByName(doc, FillPatternTarget.Drafting, name)
	if fillPatDraft != None:
		fillPat = fillPatDraft

	TransactionManager.Instance.EnsureInTransaction(doc)
	
	i = 0
	for e in elements:
		if int(app.VersionNumber) < 2019:
			id = e.Id
			if len(color)==1:
				i = 0
			graphSettings.SetCutLineColor(color[i])
			graphSettings.SetCutFillColor(color[i])
			graphSettings.SetProjectionLineColor(color[i])
			graphSettings.SetProjectionFillColor(color[i])
			graphSettings.SetCutFillPatternId(fillPat.Id)
			graphSettings.SetProjectionFillPatternId(fillPat.Id)	
			doc.ActiveView.SetElementOverrides(id, graphSettings)
		else:
			id = e.Id
			if len(color)==1:
				i = 0
			graphSettings.SetCutLineColor(color[i])
			graphSettings.SetCutForegroundPatternColor(color[i])
			graphSettings.SetCutBackgroundPatternColor(color[i])
			graphSettings.SetProjectionLineColor(color[i])
			graphSettings.SetSurfaceForegroundPatternColor(color[i])
			graphSettings.SetSurfaceBackgroundPatternColor(color[i])
			graphSettings.SetCutForegroundPatternId(fillPat.Id)
			graphSettings.SetCutBackgroundPatternId(fillPat.Id)
			graphSettings.SetSurfaceForegroundPatternId(fillPat.Id)
			graphSettings.SetSurfaceBackgroundPatternId(fillPat.Id)			
			doc.ActiveView.SetElementOverrides(id, graphSettings)		
		i += 1
		
	TransactionManager.Instance.TransactionTaskDone()
	OUT = elements
# ----------------------------------------
Selected_elements__elements = Output(python_script)  # "/*Selected elements*/ _elements"
