# Dynamo custom node Get Scope Boxes.dyf (Dynamo 0.8.2.2392)
# category: Modelical.Deprecated
# Get all the Scope Boxes in the project

python_script_getscopeboxes = Python()
# ---------- python_script_getscopeboxes.python (26 lines) ----------
import clr
clr.AddReference('ProtoGeometry')
from Autodesk.DesignScript.Geometry import *

# Import DocumentManager and TransactionManager
clr.AddReference("RevitServices")
import RevitServices
from RevitServices.Persistence import DocumentManager
from RevitServices.Transactions import TransactionManager

# Import RevitAPI
clr.AddReference("RevitAPI")
import Autodesk
from Autodesk.Revit.DB import *

doc = DocumentManager.Instance.CurrentDBDocument

#The inputs to this node will be stored as a list in the IN variable.
scopeBoxList = []

collector = FilteredElementCollector(doc).OfCategory(BuiltInCategory.OST_VolumeOfInterest)
for i in collector:
	scopeBoxList.append(i)

#Assign your output to the OUT variable
OUT = scopeBoxList
# ----------------------------------------
ScopeBoxes = Output(python_script_getscopeboxes)
