# Dynamo custom node Grid.FitToCropView.dyf (Dynamo 2.12.0.5650)
# category: Modelical.Elements.Actions
# This node fit the grids to the crop view on the selected views.

views = Input(_views: var[]..[])  # Views to fit their grids to crop view.
offset = Input(_offset: double = 0)  # Optional gap between crop view and grid end points.
fitToCropView = Python(IN[0]=views, IN[1]=offset)  # "Grid.FitToCropView"; IronPython2
# ---------- fitToCropView.python (147 lines) ----------
# This bit is default. It is always used.
# It connects with DesignScript and Dynamo internals and
# Enable Python support and load DesignScript library.
import clr
clr.AddReference("ProtoGeometry")
from Autodesk.DesignScript.Geometry import *
from Autodesk.DesignScript.Geometry import Line as rLine

# This import let's us call / use Dynamo nodes from Python code
clr.AddReference("DSCoreNodes")
from DSCore import *
# General API and User Interface API DLL

clr.AddReference("RevitAPI")
from Autodesk.Revit.DB import *
from Autodesk.Revit.DB.Structure import *

clr.AddReference("RevitAPIUI")
from Autodesk.Revit.UI import *

clr.AddReference("RevitNodes")
import Revit
clr.ImportExtensions(Revit.GeometryConversion)
clr.ImportExtensions(Revit.Elements)
# This bit is needed to access revit documents (project and families) 
# and to use Transactions (when we need to WRITE data to the Revit database)
clr.AddReference("RevitServices")
import RevitServices
from RevitServices.Persistence import DocumentManager
from RevitServices.Transactions import TransactionManager

uidoc = DocumentManager.Instance.CurrentUIApplication
doc = DocumentManager.Instance.CurrentDBDocument
app = uidoc.Application

# To be able to import Python Standard Library modules, we need to locate them
import sys
sys.path.append(r"C:\Program Files (x86)\IronPython 2.7\Lib")
# Function Helpers
def Feet2m(value):
	return value * 0.3048
	
def M2Feet(value):
	return value / 0.3048


def toList(input):
    """Return iterable if available, a list of 1 otherwise"""
    if hasattr(input, "__iter__") and not isinstance(input, basestring):
        return input
    else:
        return [input]

def flatten(x):
    result = []
    for el in x:
        if hasattr(el, "__iter__") and not isinstance(el, basestring):
            result.extend(flatten(el))
        else:
            result.append(el)
    return result

# Logic starts here
views= toList(UnwrapElement(IN[0]))
offset=M2Feet(IN[1])
# Transactions

listout=[]
size= 0.003
fList=[]
eList=[]

for view in views:
	viewGrids=[]
	
	if view == None:
		eList.append(view)
		continue
	
	
	try:
		len(FilteredElementCollector(doc,view.Id).OfCategory(BuiltInCategory.OST_Grids).ToElements())
	except:
		eList.append(view)
		continue
		

	try:
		cropLines=view.GetCropRegionShapeManager().GetCropShape()[0]
	except:
		eList.append(view)
		continue
	
	if 	len(FilteredElementCollector(doc,view.Id).OfCategory(BuiltInCategory.OST_Grids).ToElements())!=0:
	
		for grid in FilteredElementCollector(doc,view.Id).OfCategory(BuiltInCategory.OST_Grids).ToElements():	
						
			gLine=grid.GetCurvesInView(DatumExtentType.ViewSpecific, view )[0]
			
			startPoint=gLine.GetEndPoint(0)
			endPoint=gLine.GetEndPoint(1)
			
			newStart = startPoint +10*(startPoint-endPoint)
			newEnd = endPoint +10*(endPoint-startPoint)
			newGLine= Line.CreateBound(newStart,newEnd)
	
			intersectPoints=[]
				
			for cropLine in cropLines:
			
				zValue=newGLine.GetEndPoint(0).Z
				
				proCropLine=Line.CreateBound(XYZ(cropLine.GetEndPoint(0).X,cropLine.GetEndPoint(0).Y,zValue),XYZ(cropLine.GetEndPoint(1).X,cropLine.GetEndPoint(1).Y,zValue))
				
				if len(newGLine.ToProtoType().Intersect(proCropLine.ToProtoType())) > 0 :
					intersectPoints.append(newGLine.ToProtoType().Intersect(proCropLine.ToProtoType())[0])
	
			if len(intersectPoints) ==2:
				cSPoint=intersectPoints[0].ToXyz()
				cEPoint=intersectPoints[1].ToXyz()
			
				newCSPoint = cSPoint +offset*((cSPoint-cEPoint).Normalize())
				newCEPoint = cEPoint +offset*((cEPoint-cSPoint).Normalize())
				newLine= Line.CreateBound(newCEPoint,newCSPoint)
				
				gridBubble0=grid.IsBubbleVisibleInView(DatumEnds.End0,view)
				gridBubble1=grid.IsBubbleVisibleInView(DatumEnds.End1,view)
				try:
					a=grid.SetCurveInView( DatumExtentType.ViewSpecific , view, newLine)
						
					if gridBubble0 == True:
						grid.ShowBubbleInView(DatumEnds.End0,view)
					else:
						grid.HideBubbleInView(DatumEnds.End0,view)
						
					if gridBubble1 == True:
						grid.ShowBubbleInView(DatumEnds.End1,view)
					else:
						grid.HideBubbleInView(DatumEnds.End1,view)	
				except:
					None
					
		fList.append(view)
				
# Output

OUT=[fList,eList]
# ----------------------------------------
code_block = CodeBlock(l=fitToCropView) { l[0]; l[1]; }
views_2 = Output(code_block.out0)  # "_views"
errorViews = Output(code_block.out1)  # "_errorViews"
