# Dynamo custom node RoomTag To Room Location.dyf "Room Tag To Room Location" (Dynamo 0.9.0.3067)
# category: Modelical.Elements
# Move RoomTags to the location point of the room

RoomTags = Input()
python_script = Python(IN[0]=RoomTags)
# ---------- python_script.python (13 lines) ----------
import clr
clr.AddReference('ProtoGeometry')
from Autodesk.DesignScript.Geometry import *
#The inputs to this node will be stored as a list in the IN variables.
input = IN[0]

if isinstance(input,list) == False:
	elements = [input]
else:
	elements = input

#Assign your output to the OUT variable.
OUT = elements
# ----------------------------------------
flatten = Flatten(python_script)
python_script_2 = Python(IN[0]=flatten)
# ---------- python_script_2.python (32 lines) ----------
import clr
clr.AddReference('ProtoGeometry')
from Autodesk.DesignScript.Geometry import *

import clr
clr.AddReference('RevitAPI') 
clr.AddReference('RevitAPIUI') 
from Autodesk.Revit.DB import *

clr.AddReference("RevitServices")
import RevitServices
from RevitServices.Persistence import DocumentManager

clr.AddReference("RevitNodes")
import Revit
clr.ImportExtensions(Revit.GeometryConversion)

doc = DocumentManager.Instance.CurrentDBDocument
 
#The inputs to this node will be stored as a list in the IN variables.
rtags = UnwrapElement(IN[0])

t = Transaction(doc, 'Move Room Tags')
t.Start()
	
for rt in rtags:
	rt.Location.Move(rt.Room.Location.Point - rt.Location.Point)

t.Commit()

#Assign your output to the OUT variable.
OUT = rtags
# ----------------------------------------
RoomTags_2 = Output(python_script_2)  # "RoomTags"
