# Dynamo custom node Scope Boxes to Views.dyf (Dynamo 1.1.0.2094)
# category: Modelical.Views
# Create as many dependent view as needed to selected views to apply selected Scope Boxes.

Views = Input()
list_assurance = Python(IN[0]=Views)
# ---------- list_assurance.python (13 lines) ----------
import clr
clr.AddReference('ProtoGeometry')
from Autodesk.DesignScript.Geometry import *
#The inputs to this node will be stored as a list in the IN variables.
input = IN[0]

if isinstance(input,list) == False:
	elements = [input]
else:
	elements = input

#Assign your output to the OUT variable.
OUT = elements
# ----------------------------------------
flatten = Flatten(list_assurance)

# group: Filter views (plan views, elevation views, section views)
uniqueItems = List.UniqueItems(flatten)
python_script = Python(IN[0]=uniqueItems)
# ---------- python_script.python (45 lines) ----------
import clr
clr.AddReference('ProtoGeometry')
from Autodesk.DesignScript.Geometry import *

# Import DocumentManager and TransactionManager
clr.AddReference("RevitServices")
import RevitServices
from RevitServices.Persistence import DocumentManager
from RevitServices.Transactions import TransactionManager

# Import RevitAPI
clr.AddReference("RevitAPI")
import Autodesk
from Autodesk.Revit.DB import *

doc = DocumentManager.Instance.CurrentDBDocument
uiapp = DocumentManager.Instance.CurrentUIApplication
app = uiapp.Application

from System.Collections.Generic import *

# Import ToDSType(bool) extension method
clr.AddReference("RevitNodes")
import Revit
clr.ImportExtensions(Revit.Elements)
#The inputs to this node will be stored as a list in the IN variables.
views = UnwrapElement(IN[0])

filteredViews = []

for i in views:
	if not i.IsTemplate:
		if i.ViewType == ViewType.CeilingPlan:
			filteredViews.append(i.ToDSType(True))
		elif i.ViewType == ViewType.Elevation:
			filteredViews.append(i.ToDSType(True))
		elif i.ViewType == ViewType.FloorPlan:
			filteredViews.append(i.ToDSType(True))
		elif i.ViewType == ViewType.Section:
			filteredViews.append(i.ToDSType(True))
		else:
			continue

#Assign your output to the OUT variable.
OUT = filteredViews
# ----------------------------------------

# group: Is this view dependent?
code_block = CodeBlock { "Dependency"; }
getParameterValueByName = Element.GetParameterValueByName(element=python_script, parameterName=code_block)
code_block_2 = CodeBlock { "Dependent"; }
contains = String.Contains(str=getParameterValueByName, searchFor=code_block_2)
code_block_3 = CodeBlock { null; }
if_ = If(test=contains, true=code_block_3, false=python_script)

clean = List.Clean(list=if_)
ScopeBoxes = Input()
list_assurance_2 = Python(IN[0]=ScopeBoxes)  # same code as list_assurance
flatten_2 = Flatten(list_assurance_2)
count = Count(flatten_2)
ofRepeatedItem = List.OfRepeatedItem(item=clean, amount=count)
flatten_3 = Flatten(ofRepeatedItem)

# group: View Duplicate as dependent
python_script_2 = Python(IN[0]=flatten_3)
# ---------- python_script_2.python (22 lines) ----------
import clr
clr.AddReference('RevitAPI')
from Autodesk.Revit.DB import *
import Autodesk

clr.AddReference("RevitServices")
import RevitServices
from RevitServices.Persistence import DocumentManager
from RevitServices.Transactions import TransactionManager

doc = DocumentManager.Instance.CurrentDBDocument
views = UnwrapElement(IN[0])
elementlist = list()
dupopt = Autodesk.Revit.DB.ViewDuplicateOption.AsDependent

TransactionManager.Instance.EnsureInTransaction(doc)
for view in views:
	newview = view.Duplicate(dupopt)
	elementlist.append(doc.GetElement(newview))
TransactionManager.Instance.TransactionTaskDone()
	
OUT = elementlist
# ----------------------------------------

count_2 = Count(clean)
ofRepeatedItem_2 = List.OfRepeatedItem(amount=count_2)
map = List.Map(list=flatten_2, f_x=ofRepeatedItem_2)
flatten_4 = Flatten(map)

# group: Associate Scope boxes to views
code_block_4 = CodeBlock { "Scope Box"; }
setParameterByName = Element.SetParameterByName(element=python_script_2, parameterName=code_block_4, value=flatten_4)

code_block_5 = CodeBlock { "View Name"; }
code_block_6 = CodeBlock { "View Name"; }
getParameterValueByName_2 = Element.GetParameterValueByName(element=flatten_3, parameterName=code_block_6)
code_block_7 = CodeBlock { "Name"; }
getParameterValueByName_3 = Element.GetParameterValueByName(element=flatten_4, parameterName=code_block_7)
code_block_8 = CodeBlock(a=getParameterValueByName_2, b=getParameterValueByName_3) { a+"_"+b; }
setParameterByName_2 = Element.SetParameterByName(element=setParameterByName, parameterName=code_block_5, value=code_block_8)

# group: Deactivate Crop Region visibility
code_block_9 = CodeBlock { "Crop Region Visible"; }
code_block_10 = CodeBlock { 0; }
setParameterByName_3 = Element.SetParameterByName(element=setParameterByName_2, parameterName=code_block_9, value=code_block_10)

depViews = Output(setParameterByName_3)
