# Dynamo custom node Space Tag To Space Location.dyf (Dynamo 1.3.1.1736)
# category: Modelical.MEP
# Move Space Tags to the location point of the space

SpaceTags = Input()
python_script = Python(IN[0]=SpaceTags)
# ---------- python_script.python (13 lines) ----------
import clr
clr.AddReference('ProtoGeometry')
from Autodesk.DesignScript.Geometry import *
#The inputs to this node will be stored as a list in the IN variables.
input = IN[0]

if isinstance(input,list) == False:
	elements = [input]
else:
	elements = input

#Assign your output to the OUT variable.
OUT = elements
# ----------------------------------------
flatten = Flatten(python_script)
python_script_2 = Python(IN[0]=flatten)
# ---------- python_script_2.python (32 lines) ----------
import clr
clr.AddReference('ProtoGeometry')
from Autodesk.DesignScript.Geometry import *

import clr
clr.AddReference('RevitAPI') 
clr.AddReference('RevitAPIUI') 
from Autodesk.Revit.DB import *

clr.AddReference("RevitServices")
import RevitServices
from RevitServices.Persistence import DocumentManager

clr.AddReference("RevitNodes")
import Revit
clr.ImportExtensions(Revit.GeometryConversion)

doc = DocumentManager.Instance.CurrentDBDocument
 
#The inputs to this node will be stored as a list in the IN variables.
stags = UnwrapElement(IN[0])

t = Transaction(doc, 'Move Space Tags')
t.Start()
	
for st in stags:
	st.Location.Move(st.Space.Location.Point - st.Location.Point)

t.Commit()

#Assign your output to the OUT variable.
OUT = stags
# ----------------------------------------
SpaceTags_2 = Output(python_script_2)  # "SpaceTags"
