# Dynamo custom node Space and Tag Location Centering.dyf (Dynamo 1.3.1.1736)
# category: Modelical.MEP
# Move space location point and its tag to its centroid. If centroid is located outside the space, location point stays at its origin coords.

Spaces = Input()
python_script_list_assurance = Python(IN[0]=Spaces)
# ---------- python_script_list_assurance.python (13 lines) ----------
import clr
clr.AddReference('ProtoGeometry')
from Autodesk.DesignScript.Geometry import *
#The inputs to this node will be stored as a list in the IN variables.
input = IN[0]

if isinstance(input,list) == False:
	elements = [input]
else:
	elements = input

#Assign your output to the OUT variable.
OUT = elements
# ----------------------------------------
flatten = Flatten(python_script_list_assurance)
python_script = Python(IN[0]=flatten)
# ---------- python_script.python (67 lines) ----------
#Made by Modelical http://www.modelical.com
#With the help of a node by Konrad Sobon
# @arch_laboratory, http://archi-lab.net

import clr
clr.AddReference('RevitAPI')
from Autodesk.Revit.DB import *
import Autodesk

clr.AddReference("RevitNodes")
import Revit
clr.ImportExtensions(Revit.GeometryConversion)

clr.AddReference("RevitServices")
import RevitServices
from RevitServices.Persistence import DocumentManager

doc = DocumentManager.Instance.CurrentDBDocument
rooms = UnwrapElement(IN[0])

boundarylist = []
boundarylistFlattened = []
curvelist = []
curves = []
outputCurves = []

options = Autodesk.Revit.DB.SpatialElementBoundaryOptions()

for r in rooms:
	boundarylist.append(r.GetBoundarySegments(options))

for b in boundarylist:
	boundarylistFlattened.append([item for sublist in b for item in sublist])


for segment in boundarylistFlattened:
	curves = []
	for s in segment:
		curves.append(s.GetCurve().ToProtoType())
	curvelist.append(curves)


def groupCurves(Line_List): 
	ignore_distance = 0.01 # Assume points this close or closer to each other are touching 
	Grouped_Lines = [] 
	Queue = set() 
	while Line_List: 
		Shape = [] 
		Queue.add(Line_List.pop()) # Move a line from the Line_List to our queue 
		while Queue: 
			Current_Line = Queue.pop() 
			Shape.append(Current_Line) 
			for Potential_Match in Line_List: 
				Points = (Potential_Match.StartPoint, Potential_Match.EndPoint)
				for P1 in Points: 
					for P2 in (Current_Line.StartPoint, Current_Line.EndPoint): 
						distance = P1.DistanceTo(P2) 
						if distance <= ignore_distance: 
							Queue.add(Potential_Match) 
			Line_List = [item for item in Line_List if item not in Queue]
		Grouped_Lines.append(Shape) 
	return Grouped_Lines
	
for c in curvelist:
	outputCurves.append(groupCurves(c))

OUT = outputCurves
# ----------------------------------------
byJoinedCurves = PolyCurve.ByJoinedCurves(python_script)
length = Curve.Length(byJoinedCurves)
python_script_sort_by_key = Python(IN[0]=length, IN[1]=flatten)
# ---------- python_script_sort_by_key.python (24 lines) ----------
import clr
clr.AddReference('ProtoGeometry')
from Autodesk.DesignScript.Geometry import *

keys = IN[0]
ls = IN[1]

for slot in range(len(keys)-1, 0, -1):
	positionOfMax = 0
	
	for location in range(1, slot+1):
		if keys[location] > keys[positionOfMax]:
			positionOfMax = location

	temp = keys[slot]
	keys[slot] = keys[positionOfMax]
	keys[positionOfMax] = temp
	
	temp2 = ls[slot]
	ls[slot] = ls[positionOfMax]
	ls[positionOfMax] = temp2

OUT = []
OUT.append(ls)
# ----------------------------------------
flatten_2 = Flatten(python_script_sort_by_key)
python_script_sort_by_key_2 = Python(IN[0]=length, IN[1]=byJoinedCurves)  # same code as python_script_sort_by_key
code_block = CodeBlock { 1; }
flatten_3 = List.Flatten(list=python_script_sort_by_key_2, amt=code_block)
lastItem = List.LastItem()  # unwired: arg0
map = List.Map(list=flatten_3, f_x=lastItem)
extrudeAsSolid = Curve.ExtrudeAsSolid(map)
centroid = Solid.Centroid(extrudeAsSolid)
startPoint = Curve.StartPoint(map)
code_block_2 = CodeBlock(p1=centroid, p2=startPoint) { centroid = Autodesk.Point.ByCoordinates(p1.X, p1.Y, p2.Z); }
python_script_centroid_inside = Python(IN[0]=flatten_2, IN[1]=code_block_2)  # "Python Script (Centroid inside space?)"
# ---------- python_script_centroid_inside.python (25 lines) ----------
import clr
clr.AddReference('RevitAPI')
from Autodesk.Revit.DB import *

clr.AddReference("RevitNodes")
import Revit
clr.ImportExtensions(Revit.GeometryConversion)

spaces = UnwrapElement(IN[0])
points = [x.ToXyz() for x in IN[1]]

spaceBools = []
count = 0

for s in spaces:
	try:
		if s.IsPointInSpace(points[count]):
			spaceBools.append(True)
		else:
			spaceBools.append(False)
	except:
		spaceBools.append(False)
	count = count + 1

OUT = spaceBools
# ----------------------------------------
filterByBoolMask = List.FilterByBoolMask(list=flatten_2, mask=python_script_centroid_inside)
flatten_4 = Flatten(filterByBoolMask.in)
end = Revit.Transaction.Transaction.End(flatten_4)
filterByBoolMask_2 = List.FilterByBoolMask(list=code_block_2, mask=python_script_centroid_inside)
flatten_5 = Flatten(filterByBoolMask_2.in)
end_2 = Revit.Transaction.Transaction.End(flatten_5)
python_script_move_location = Python(IN[0]=end, IN[1]=end_2)  # "Python Script (Move Location Point)"
# ---------- python_script_move_location.python (57 lines) ----------
import clr
clr.AddReference('ProtoGeometry')
from Autodesk.DesignScript.Geometry import *

import clr
clr.AddReference('RevitAPI') 
clr.AddReference('RevitAPIUI') 
from Autodesk.Revit.DB import *

clr.AddReference("RevitServices")
import RevitServices
from RevitServices.Persistence import DocumentManager

clr.AddReference("RevitNodes")
import Revit
clr.ImportExtensions(Revit.GeometryConversion)

doc = DocumentManager.Instance.CurrentDBDocument
 
#The inputs to this node will be stored as a list in the IN variables.
spaces = UnwrapElement(IN[0])
points = [x.ToXyz() for x in IN[1]]
stags = []
spacesMoved = []
locations = []
tagsMoved = []
count = 0


t1 = Transaction(doc, 'Move Space Location')
t1.Start()
	
for s in spaces:
	P = points[count] - s.Location.Point
	s.Location.Move(P)
	spacesMoved.append(s)
	count = count + 1

t1.Commit()

collector = FilteredElementCollector(doc).OfCategory(BuiltInCategory.OST_MEPSpaceTags).WhereElementIsNotElementType()
for i in collector:
	stags.append(i)

t2 = Transaction(doc, 'Move Space Tags')
t2.Start()

for rt in stags:
	for s in spacesMoved:
		if rt.Space.Id == s.Id:
			rt.Location.Move(rt.Space.Location.Point - rt.Location.Point)
			tagsMoved.append(rt)
			break
t2.Commit()

#Assign your output to the OUT variable.
OUT = spacesMoved, tagsMoved
# ----------------------------------------
code_block_3 = CodeBlock(l=python_script_move_location) { l[0]; l[1]; }
SpacesMoved = Output(code_block_3.out0)
TagsMoved = Output(code_block_3.out1)
