# Dynamo custom node Structure.DisableAnalyticalModel.dyf (Dynamo 2.12.0.5650)
# category: Modelical.Elements.Actions
# This node enables or disables the analytical model.

bool = Input(_bool: bool = false)  # Set Toggle to TRUE to disable analytical model
python_script = Python(IN[0]=bool)  # IronPython2
# ---------- python_script.python (91 lines) ----------
# This node has been made by Modelical
# www.modelical.com

import clr
clr.AddReference("ProtoGeometry")
from Autodesk.DesignScript.Geometry import *


clr.AddReference("DSCoreNodes")
from DSCore import *


clr.AddReference("RevitAPI")
from Autodesk.Revit.DB import *
from Autodesk.Revit.DB.Structure import *

clr.AddReference("RevitAPIUI")
from Autodesk.Revit.UI import *

clr.AddReference("RevitNodes")
import Revit
clr.ImportExtensions(Revit.GeometryConversion)
clr.ImportExtensions(Revit.Elements)


clr.AddReference("RevitServices")
import RevitServices
from RevitServices.Persistence import DocumentManager
from RevitServices.Transactions import TransactionManager

uidoc = DocumentManager.Instance.CurrentUIApplication
doc = DocumentManager.Instance.CurrentDBDocument
app = uidoc.Application


import sys
sys.path.append(r"C:\Program Files (x86)\IronPython 2.7\Lib")
# Function Helpers
def Feet2m(value):
	return value * 0.3048

def toList(input):

    if hasattr(input, "__iter__") and not isinstance(input, basestring):
        return iter(input)
    else:
        return [input]

def flatten(x):
    result = []
    for el in x:
        if hasattr(el, "__iter__") and not isinstance(el, basestring):
            result.extend(flatten(el))
        else:
            result.append(el)
    return result

# Logic starts here
bool = IN[0]
if bool==True:
	setValue=0
	state="Disabled"
else:
	setValue=1
	state="Enabled"
	
strElements=[]

for a in FilteredElementCollector(doc).OfCategory(BuiltInCategory.OST_StructuralColumns).ToElements():
	strElements.append(a)
for b in FilteredElementCollector(doc).OfCategory(BuiltInCategory.OST_StructuralFraming).ToElements():
	strElements.append(b)
for c in FilteredElementCollector(doc).OfCategory(BuiltInCategory.OST_Walls).ToElements():
	strElements.append(c)
for d in FilteredElementCollector(doc).OfCategory(BuiltInCategory.OST_StructuralFoundation).ToElements():
	strElements.append(d)
for e in FilteredElementCollector(doc).OfCategory(BuiltInCategory.OST_StructuralTruss).ToElements():
	strElements.append(e)
for f in FilteredElementCollector(doc).OfCategory(BuiltInCategory.OST_Floors).ToElements():
	strElements.append(f)
	
TransactionManager.Instance.EnsureInTransaction(doc)	
for ele in strElements:
	try:
		a=ele.get_Parameter(BuiltInParameter.STRUCTURAL_ANALYTICAL_MODEL).Set(setValue)
	except:
		None
		
TransactionManager.Instance.TransactionTaskDone()
# Output
OUT = state
# ----------------------------------------
Analytical_model_status__status = Output(python_script)  # "/*Analytical model status*/ _status"
