# Dynamo custom node Vector similarity.dyf (Dynamo 1.3.1.1736)
# category: Modelical.Geometry
# Check if a vector is similar to other, with a tolerance.

v1 = Input(v1 : Vector)
v2 = Input(v2 : Vector)
Tolerance = Input(Tolerance : double = 0.000001)
python_script = Python(IN[0]=v1, IN[1]=v2, IN[2]=Tolerance)
# ---------- python_script.python (46 lines) ----------
# This node has been made by Modelical
# www.modelical.com

import clr
clr.AddReference('ProtoGeometry')
from Autodesk.DesignScript.Geometry import *

from math import *

#Load Dynamo wrappers
clr.AddReference("RevitNodes")
import Revit
from Revit.Elements import *
clr.ImportExtensions(Revit.GeometryConversion)
clr.ImportExtensions(Revit.Elements)

def toList(input):
	if isinstance(input,list) == False:
		return [input]
	else:
		return input

def flatten(x):
    result = []
    for el in x:
        if hasattr(el, "__iter__") and not isinstance(el, basestring):
            result.extend(flatten(el))
        else:
            result.append(el)
    return result

def vecSimilarity(v1,v2,tolerance):
	if abs(v1.X - v2.X) <= tolerance and abs(v1.Y - v2.Y) <= tolerance and abs(v1.Z - v2.Z) <= tolerance:
		return True
	else:
		return False


vec1 = flatten(toList(IN[0]))
vec2 = flatten(toList(IN[1]))
tolerance = IN[2]

result = vecSimilarity(vec1[0],vec2[0],tolerance)


OUT = result
# ----------------------------------------
Similar = Output(python_script)  # "Similar?"
