# Dynamo custom node 3D Views To NWC Export.dyf (Dynamo 2.5.0.7460)
# category: NWC Export
# This Node can export a list of 3d Views.

Directory_Name = Input(Directory_Name: var[]..[])
views = Input(views: var[]..[])
Boolean = Input(Boolean: var[]..[])
n3d_views_to_nwc = Python(IN[0]=Directory_Name, IN[1]=views, IN[2]=Boolean)  # "3D Views to NWC"
# ---------- n3d_views_to_nwc.python (34 lines) ----------
import clr

clr.AddReference('ProtoGeometry')
from Autodesk.DesignScript.Geometry import*

clr.AddReference('RevitAPI')
from Autodesk.Revit.DB import*

clr.AddReference('RevitServices')
from RevitServices.Persistence import DocumentManager

import System
from System.Collections.Generic import *


doc = DocumentManager.Instance.CurrentDBDocument

folder = IN[0]
names = IN[1]

collector = FilteredElementCollector(doc).OfClass(View)
options = NavisworksExportOptions()
options.ExportScope = NavisworksExportScope.View
options.ExportLinks = True

OUT = []
if IN[2]:
    for i in names:
        viewstring = i.Name
        OUT.append(viewstring)
        for view in collector:
            if (view.ViewType == ViewType.ThreeD and view.Name.Contains(viewstring)):
                options.ViewId = view.Id
                doc.Export(folder, "Export" + " - " + view.Name + ".nwc", options)
# ----------------------------------------
