# Dynamo custom node OptimaX.dyf (Dynamo 0.8.0.950)
# category: Optimo
# Optimize Shell Structure 1

integer_slider = IntegerSlider(49, range=0..100 step 1)
integer_slider_2 = IntegerSlider(35, range=0..100 step 1)
code_block = CodeBlock(u=integer_slider, v=integer_slider_2) { UV.ByCoordinates((0..1..1/u)<1>,(0..1..1/v)<2>); }
flatten = Flatten(code_block)
Face = Input()
byParametersOnSurface = Tessellation.Voronoi.ByParametersOnSurface(flatten, Face)
byLine = DynamoSimulation.RSA.AnalyticalModel.AnalyticalBar.ByLine(byParametersOnSurface)
sections = SectionBar("UC 305x305x97")
setSectionByName = DynamoSimulation.RSA.AnalyticalModel.AnalyticalBar.SetSectionByName(byLine, sections)
calculate = DynamoSimulation.RSA.RSACore.Calculate(setSectionByName)
Output = Output(calculate)  # ""
