# Dynamo custom node BBox Fitness Function.dyf (Dynamo 0.7.5.3566)
# category: Optimo
# The Fitness Function for Optimo's Bounding Box Example (Minimizing Bounding Box Volume)

Geometry = Input()
byGeometry = BoundingBox.ByGeometry(Geometry)
minPoint = BoundingBox.MinPoint(byGeometry)
maxPoint = BoundingBox.MaxPoint(byGeometry)
byStartPointEndPoint = Line.ByStartPointEndPoint(minPoint, maxPoint)
code_block = CodeBlock { 0.5; }
pointAtParameter = Curve.PointAtParameter(byStartPointEndPoint, code_block)
XAxis = Vector.XAxis()
List = Input()
code_block_2 = CodeBlock(pop=List) { pop[0]; pop[1]; pop[2]; }
rotate = Geometry.Rotate(Geometry, pointAtParameter, XAxis, code_block_2.out0, lacing=Longest)
YAxis = Vector.YAxis()
rotate_2 = Geometry.Rotate(rotate, pointAtParameter, YAxis, code_block_2.out1, lacing=Longest)
ZAxis = Vector.ZAxis()
rotate_3 = Geometry.Rotate(rotate_2, pointAtParameter, ZAxis, code_block_2.out2, lacing=Longest)
byGeometry_2 = BoundingBox.ByGeometry(rotate_3, lacing=Longest)
maxPoint_2 = BoundingBox.MaxPoint(byGeometry_2, lacing=Longest)
minPoint_2 = BoundingBox.MinPoint(byGeometry_2, lacing=Longest)
byCorners = Cuboid.ByCorners(maxPoint_2, minPoint_2, lacing=Longest)
volume = Solid.Volume(byCorners, lacing=Longest)
Volume = Output(volume)
