# Dynamo custom node NSGA_II Function.dyf (Dynamo 0.7.5.3566)
# category: Optimo
# The function that performs the generation for NSGA_II.

init = Input()
code_block = CodeBlock(lst=init) { lst[0]; lst[1]; }
add_counter = CodeBlock(a=code_block.out0) { a+1; }
lowerLimits = Input()
upperLimits = Input()
generationAlgorithm = Optimo.NSGA_II.GenerationAlgorithm(code_block.out1, lowerLimits, upperLimits)
Fitness_Function_List = Input()
apply = ApplyFunction(Fitness_Function_List, generationAlgorithm)  # "Function.Apply"
assignFitnessFuncResults = Optimo.NSGA_II.AssignFitnessFuncResults(generationAlgorithm, apply)
sorting = Optimo.NSGA_II.Sorting(code_block.out1, assignFitnessFuncResults, lowerLimits, upperLimits)
create = List.Create(add_counter, sorting)
Results = Output(create)
