# Dynamo custom node Point on Surface Fitness Function.dyf (Dynamo 0.7.5.3566)
# category: Optimo
# The Fitness Function for Optimo's Point on Surface Example

Population_List = Input()
code_block = CodeBlock(pop=Population_List) { pop[0]; }
code_block_2 = CodeBlock(pop=Population_List) { pop[1]; }
code_block_3 = CodeBlock(x=code_block, y=code_block_2) { Point.ByCoordinates(x,y,0); }
ZAxis = Vector.ZAxis()
code_block_4 = CodeBlock { 200; }
byStartPointDirectionLength = Line.ByStartPointDirectionLength(code_block_3, ZAxis, code_block_4)
Face = Input()
intersect = Geometry.Intersect(byStartPointDirectionLength, Face, lacing=Longest)
code_block_5 = CodeBlock(intersect) { P.Z; }
code_block_6 = CodeBlock { 1; }
flatten = List.Flatten(code_block_5, code_block_6)
Fitness_Value = Output(flatten)
