# Dynamo custom node SCH Fitness Function-1.dyf (Dynamo 0.7.5.3566)
# category: Optimo
# The Fitness Function for Optimo's SCH Example

List = Input()
firstItem = List.FirstItem(List)
code_block = CodeBlock { 2; }
pow = Math.Pow(firstItem, code_block, lacing=Longest)
double = Output(pow)
