# Dynamo custom node SCH Fitness Function-2.dyf (Dynamo 0.7.5.3566)
# category: Optimo
# The Fitness Function for Optimo's SCH Example

List = Input()
firstItem = List.FirstItem(List)
code_block = CodeBlock { 2; }
sub = firstItem - code_block
code_block_2 = CodeBlock { 2; }
pow = Math.Pow(sub, code_block_2, lacing=Longest)
double = Output(pow)
