# Dynamo custom node PipeGeomProps.dyf (Dynamo 0.7.6.4122)
# category: Analyze
# Geometrical characteristics of pipes

# note: © Khasan Mamaev, 2015
# http://hasan-mamay.blogspot.ru
D = Input()
t = Input()
python_script = Python(IN[0]=D, IN[1]=t)
# ---------- python_script.python (16 lines) ----------
import clr
clr.AddReference('ProtoGeometry')
from Autodesk.DesignScript.Geometry import *
import math
#The inputs to this node will be stored as a list in the IN variable.
dataEnteringNode = IN
d=IN[0]
t=IN[1]

As=math.pi*(d**2-(d-2*t)**2)/4
W=math.pi*(d**3-(d-2*t)**3)/32
I=math.pi*(d**4-(d-2*t)**4)/64
i=(I/As)**0.5

#Assign your output to the OUT variable
OUT = [As,W,I,i]
# ----------------------------------------
code_block = CodeBlock(a=python_script) { a[0]; }
As = Output(code_block)
code_block_2 = CodeBlock(a=python_script) { a[1]; }
W = Output(code_block_2)
code_block_3 = CodeBlock(a=python_script) { a[2]; }
I = Output(code_block_3)
code_block_4 = CodeBlock(a=python_script) { a[3]; }
i = Output(code_block_4)
