# Dynamo custom node Check.SystemType.dyf (Dynamo 0.8.1.1942)
# category: QA
# Check if pipe has system type

Elements = Input()

# group: Has system type?
code_block = CodeBlock { "System Type"; }
getParameterValueByName = Element.GetParameterValueByName(element=Elements, parameterName=code_block)
string_from_object = FromObject()
map = List.Map(list=getParameterValueByName, f_x=string_from_object)
code_block_2 = CodeBlock { "PipingSystemType"; }
contains = String.Contains(searchFor=code_block_2)
map_2 = List.Map(list=map, f_x=contains)
filterByBoolMask = List.FilterByBoolMask(list=Elements, mask=map_2)

With_system = Output(filterByBoolMask.in)
Without_system = Output(filterByBoolMask.out)
