# Dynamo custom node CheckSystem.dyf (Dynamo 0.8.1.1942)
# category: QA
# Return pipes with a specific System Type.
# SystemType must be entered by its ID.
# 607132 Sanitary

Elements = Input()
System_ID = Input()
code_block = CodeBlock { "System Type"; }
getParameterValueByName = Element.GetParameterValueByName(element=Elements, parameterName=code_block)
id = Element.Id(getParameterValueByName)
string_from_object = FromObject()
map = List.Map(list=id, f_x=string_from_object)
toNumber = String.ToNumber()
map_2 = List.Map(list=map, f_x=toNumber)
eq = System_ID == map_2
filterByBoolMask = List.FilterByBoolMask(list=Elements, mask=eq)
