# Dynamo custom node Place.Windows.Doors.InWalls.dyf (Dynamo 0.7.2.1825)
# category: KOP
# Places windows in midpoints of a list of walls

Walls = Input()
Window_Door_Type = Input()  # "Window /Door Type"
Sill_Height = Input()
python_script = Python(IN[0]=Walls, IN[1]=Window_Door_Type, IN[2]=Sill_Height)
# ---------- python_script.python (55 lines) ----------
import clr
clr.AddReference('ProtoGeometry')
from Autodesk.DesignScript.Geometry import *

# Import RevitAPI
clr.AddReference('RevitAPI')
import Autodesk

# Import DocumentManager and TransactionManager
clr.AddReference('RevitServices')
import RevitServices
from RevitServices.Persistence import DocumentManager
from RevitServices.Transactions import TransactionManager

# Import ToDSType(bool) extension method
clr.AddReference('RevitNodes')
import Revit
clr.ImportExtensions(Revit.Elements)

walls = UnwrapElement(IN[0])
windowfamily = UnwrapElement(IN[1])
SillHeight = IN[2]/0.3048

wall = []


doc = DocumentManager.Instance.CurrentDBDocument
uiapp = DocumentManager.Instance.CurrentUIApplication
app = uiapp.Application
TransactionManager.Instance.EnsureInTransaction(doc)

for i in range (0,len(walls)):
	
	wall = walls[i]
	#search for existing windows and delete
	elList = wall.FindInserts(True, False, False, False)
	for elemId in elList:
		doc.Delete(elemId)
	# extract wall geometry and calculate middlepoint
	locCurve = wall.Location
	wallLength = locCurve.Curve.Length

	start = locCurve.Curve.GetEndPoint(0)
	end = locCurve.Curve.GetEndPoint(1)

	mittex = (start.X + end.X)/2
	mittey = (start.Y + end.Y)/2
	
	location = Autodesk.Revit.DB.XYZ(mittex,mittey,start.Z)

	famInst = doc.Create.NewFamilyInstance(location, windowfamily, wall, Autodesk.Revit.DB.Structure.StructuralType.NonStructural)
	famInst.get_Parameter('Sill Height').Set(SillHeight)

# End Transaction
TransactionManager.Instance.TransactionTaskDone()
# ----------------------------------------
OUT = Output(python_script)
