# Dynamo custom node Point.Overlap.AdaptiveComponents.dyf (Dynamo 0.8.0.950)
# category: Core
# Takes an aray of points, subdivides them into specified chuncks with specified offset with chuncks of 3 [i.e. offset 2, {a,b,c,d,e,f...} yields {a,b,c},{c,d,e},{e,f,g}...Works for adaptive components such as railings or lines that need to be joined.

Points = Input()
Range = Input()
SubLengthChunck = Input()
formula = Formula("Chunck - 1", Chunck=SubLengthChunck)
list_of_points_lapsing_backwards = List.Sublists(list=Points, ranges=Range, offset=formula)  # "List of Points - Lapsing Backwards by 1"
number = DoubleInput(1)
flatten = List.Flatten(list=list_of_points_lapsing_backwards, amt=number)
chop = List.Chop(flatten, SubLengthChunck)
Adaptive_Points = Output(chop)
