# Dynamo custom node AddingStartandEndAnglesbyLastSequence.dyf (Dynamo 2.6.1.8786)
# category: PracticalBIM.Geometry.Abstract.Vector
# Adding Start and End Angles by Last Sequence
# packages: PracticalBIM 2020.0.26

AnglesofRotation = Input(AnglesofRotation: double[])
code_block = CodeBlock { -1; }
shiftIndices = List.ShiftIndices(list=AnglesofRotation, amount=code_block)
removeLast = Custom[RemoveLast](list=shiftIndices)  # package PracticalBIM; Remove Last element of a List
lastItem = List.LastItem(list=removeLast)
removeLast_2 = Custom[RemoveLast](list=AnglesofRotation)
code_block_2 = CodeBlock(a=removeLast_2, b=removeLast) { a-b; }
lastItem_2 = List.LastItem(list=code_block_2)
code_block_3 = CodeBlock(a=lastItem, b=lastItem_2) { a-b; }
firstItem = List.FirstItem(list=removeLast_2)
firstItem_2 = List.FirstItem(list=code_block_2)
code_block_4 = CodeBlock(a=firstItem, b=firstItem_2) { a+b; }
addItemToFront = List.AddItemToFront(item=code_block_4, list=AnglesofRotation)
addItemToEnd = List.AddItemToEnd(item=code_block_3, list=addItemToFront)
FinalAngles = Output(addItemToEnd)  # "FinalAngles:double[]"
LastEndingDifference = Output(lastItem_2)  # "LastEndingDifference:double[]"
