# Dynamo custom node AddingStartandEndVectorbyDiferentials.dyf (Dynamo 2.6.1.8786)
# category: PracticalBIM.Geometry.Abstract
# Adds Start and End Vector by Diferentials

OrientationVectors = Input(OrientationVectors: Autodesk.DesignScript.Geometry.Vector[])
firstItem = List.FirstItem(list=OrientationVectors)
ZAxis = Vector.ZAxis()
DiferentialValues = Input(DiferentialValues: double[])
firstItem_2 = List.FirstItem(list=DiferentialValues)
code_block = CodeBlock(a=firstItem_2) { a*-1; }
rotate = Vector.Rotate(vector=firstItem, axis=ZAxis, degrees=code_block)
lastItem = List.LastItem(list=OrientationVectors)
lastItem_2 = List.LastItem(list=DiferentialValues)
rotate_2 = Vector.Rotate(vector=lastItem, axis=ZAxis, degrees=lastItem_2)
addItemToEnd = List.AddItemToEnd(item=rotate_2, list=OrientationVectors)
addItemToFront = List.AddItemToFront(item=rotate, list=addItemToEnd)
ResultingVectors = Output(addItemToFront)  # "ResultingVectors:Vector[]"
