# Dynamo custom node AllocateFacesofaSolid.dyf (Dynamo 2.3.0.5885)
# category: PracticalBIM.Rebar.Geometry
# Separate all faces of a Solid for Analysis

solids = Input(solids: Autodesk.DesignScript.Geometry.Solid[])
faces = Topology.Faces(topology=solids)
surfaceGeometry = Face.SurfaceGeometry(face=faces)
flatten = List.Flatten(list=surfaceGeometry)
normalAtParameter = Surface.NormalAtParameter(surface=flatten)
Z = Vector.Z(vector=normalAtParameter)
code_block = CodeBlock { 1; }
eq = Z == code_block
code_block_2 = CodeBlock { -1; }
eq_2 = Z == code_block_2
code_block_3 = CodeBlock { 0.2; }
gt = Z > code_block_3
code_block_4 = CodeBlock { true; }
allIndicesOf = List.AllIndicesOf(list=gt, item=code_block_4)
top_side = List.GetItemAtIndex(list=flatten, index=allIndicesOf)
TopSide = Output(top_side)  # "TopSide:Surface[]"
code_block_5 = CodeBlock { -0.2; }
lt = Z < code_block_5
code_block_6 = CodeBlock { true; }
allIndicesOf_2 = List.AllIndicesOf(list=lt, item=code_block_6)
bottom_side = List.GetItemAtIndex(list=flatten, index=allIndicesOf_2)
BottomSide = Output(bottom_side)  # "BottomSide:Surface[]"
join = List.Join(list0=allIndicesOf, list1=allIndicesOf_2)
removeItemAtIndex = List.RemoveItemAtIndex(list=flatten, indices=join)
area = Surface.Area(surface=removeItemAtIndex)
code_block_7 = CodeBlock { 2; }
round = Math.Round(number=area, digits=code_block_7)
minimumItem = List.MinimumItem(list=round)
allIndicesOf_3 = List.AllIndicesOf(list=round, item=minimumItem)
small_sides = List.GetItemAtIndex(list=removeItemAtIndex, index=allIndicesOf_3)
SmallSides = Output(small_sides)  # "SmallSides:Surface[]"
long_sides = List.RemoveItemAtIndex(list=removeItemAtIndex, indices=allIndicesOf_3)
LongSides = Output(long_sides)  # "LongSides:Surface[]"
