# Dynamo custom node AllocateFacesofaSolidHorizontalMax.dyf (Dynamo 2.6.1.8786)
# category: PracticalBIM.Geometry.Abstract
# Allocate the Faces of a Solid for Horizontal Elements
# packages: PracticalBIM 2020.0.39

Selectedelement = Input(Selectedelement: Revit.Elements.Element)
geometry = Element.Geometry(element=Selectedelement)
faces = Topology.Faces(topology=geometry)
surfaceGeometry = Face.SurfaceGeometry(face=faces)
flatten = List.Flatten(list=surfaceGeometry)
vertices = Topology.Vertices(topology=geometry)
pointGeometry = Vertex.PointGeometry(vertex=vertices)
byBestFitThroughPoints = Line.ByBestFitThroughPoints(bestFitPoints=pointGeometry)
direction = Line.Direction(line=byBestFitThroughPoints)
code_block = CodeBlock { 0.5; }
pointAtParameter = Curve.PointAtParameter(curve=byBestFitThroughPoints, param=code_block)
coordinateSystembyPointandVectorOveraCur = Custom[CoordinateSystembyPointandVectorOveraCurveforLinearFamilies](vector=direction, origin=pointAtParameter)  # package PracticalBIM; Creates a Coordinate System on Everypoint with Vectors over a Curve
byCartesianCoordinates = Point.ByCartesianCoordinates(cs=coordinateSystembyPointandVectorOveraCur)
code_block_2 = CodeBlock { 1; }
byCartesianCoordinates_2 = Point.ByCartesianCoordinates(cs=coordinateSystembyPointandVectorOveraCur, y=code_block_2)
byTwoPoints = Vector.ByTwoPoints(start=byCartesianCoordinates, end=byCartesianCoordinates_2)
normalAtParameter = Surface.NormalAtParameter(surface=flatten)
angleWithVector = Vector.AngleWithVector(vector=byTwoPoints, otherVector=normalAtParameter, lacing=CrossProduct)
code_block_3 = CodeBlock { 0; }
round = Math.Round(number=angleWithVector, digits=code_block_3)
code_block_4 = CodeBlock { 0; }
eq = round == code_block_4  # lacing=Longest
flatten_2 = List.Flatten(list=eq)
code_block_5 = CodeBlock { true; }
indexOf = List.IndexOf(list=flatten_2, element=code_block_5)
top_side = List.GetItemAtIndex(list=flatten, index=indexOf)
Topsurface = Output(top_side)  # "Topsurface:Surface"
code_block_6 = CodeBlock { -1; }
byCartesianCoordinates_3 = Point.ByCartesianCoordinates(cs=coordinateSystembyPointandVectorOveraCur, y=code_block_6)
byTwoPoints_2 = Vector.ByTwoPoints(start=byCartesianCoordinates, end=byCartesianCoordinates_3)
angleWithVector_2 = Vector.AngleWithVector(vector=byTwoPoints_2, otherVector=normalAtParameter, lacing=CrossProduct)
code_block_7 = CodeBlock { 0; }
round_2 = Math.Round(number=angleWithVector_2, digits=code_block_7)
code_block_8 = CodeBlock { 0; }
eq_2 = round_2 == code_block_8  # lacing=Longest
flatten_3 = List.Flatten(list=eq_2)
code_block_9 = CodeBlock { true; }
indexOf_2 = List.IndexOf(list=flatten_3, element=code_block_9)
bottom_side = List.GetItemAtIndex(list=flatten, index=indexOf_2)
Bottomsurface = Output(bottom_side)  # "Bottomsurface:Surface"
join = List.Join(list0=indexOf, list1=indexOf_2)
removeItemAtIndex = List.RemoveItemAtIndex(list=flatten, indices=join)
area = Surface.Area(surface=removeItemAtIndex)
code_block_10 = CodeBlock { 2; }
round_3 = Math.Round(number=area, digits=code_block_10)
minimumItem = List.MinimumItem(list=round_3)
allIndicesOf = List.AllIndicesOf(list=round_3, item=minimumItem)
small_sides = List.GetItemAtIndex(list=removeItemAtIndex, index=allIndicesOf)
Smallsidesurface = Output(small_sides)  # "Smallsidesurface:Surface"
long_sides = List.RemoveItemAtIndex(list=removeItemAtIndex, indices=allIndicesOf)
Longsidesurface = Output(long_sides)  # "Longsidesurface:Surface"
