# Dynamo custom node AllocatefacesofaSolidFloorsandFramings.dyf (Dynamo 2.3.0.5885)
# category: PracticalBIM.Geometry.Surfaces
# Allocate the Faces of a Solid of type Floor and Framings by using the vectors z and the max area

Selectedelement = Input(Selectedelement: Revit.Elements.Element)
geometry = Element.Geometry(element=Selectedelement)
faces = Topology.Faces(topology=geometry)
surfaceGeometry = Face.SurfaceGeometry(face=faces)
flatten = List.Flatten(list=surfaceGeometry)
code_block = CodeBlock { 0.5; }
normalAtParameter = Surface.NormalAtParameter(surface=flatten, u=code_block, v=code_block)
Z = Vector.Z(vector=normalAtParameter)
code_block_2 = CodeBlock { 2; }
round = Math.Round(number=Z, digits=code_block_2)
minimumItem = List.MinimumItem(list=round)
eq = round == minimumItem
flatten_2 = List.Flatten(list=eq)
code_block_3 = CodeBlock { true; }
allIndicesOf = List.AllIndicesOf(list=flatten_2, item=code_block_3)
getItemAtIndex = List.GetItemAtIndex(list=flatten, index=allIndicesOf)
maximumItem = List.MaximumItem(list=round)
eq_2 = round == maximumItem
flatten_3 = List.Flatten(list=eq_2)
allIndicesOf_2 = List.AllIndicesOf(list=flatten_3, item=code_block_3)
getItemAtIndex_2 = List.GetItemAtIndex(list=flatten, index=allIndicesOf_2)
area = Surface.Area(surface=getItemAtIndex_2)
maximumItem_2 = List.MaximumItem(list=area)
indexOf = List.IndexOf(list=area, element=maximumItem_2)
getItemAtIndex_3 = List.GetItemAtIndex(list=allIndicesOf_2, index=indexOf)
top_side = List.GetItemAtIndex(list=flatten, index=getItemAtIndex_3)
Topsurface = Output(top_side)  # "Topsurface:Surface"
getItemAtIndex_4 = List.GetItemAtIndex(list=flatten, index=allIndicesOf)
area_2 = Surface.Area(surface=getItemAtIndex_4)
maximumItem_3 = List.MaximumItem(list=area_2)
indexOf_2 = List.IndexOf(list=area_2, element=maximumItem_3)
getItemAtIndex_5 = List.GetItemAtIndex(list=allIndicesOf, index=indexOf_2)
bottom_side = List.GetItemAtIndex(list=flatten, index=getItemAtIndex_5)
Bottomsurface = Output(bottom_side)  # "Bottomsurface:Surface"
join = List.Join(list0=getItemAtIndex_3, list1=getItemAtIndex_5)
removeItemAtIndex = List.RemoveItemAtIndex(list=flatten, indices=join)
area_3 = Surface.Area(surface=removeItemAtIndex)
code_block_4 = CodeBlock { 2; }
round_2 = Math.Round(number=area_3, digits=code_block_4)
minimumItem_2 = List.MinimumItem(list=round_2)
allIndicesOf_3 = List.AllIndicesOf(list=round_2, item=minimumItem_2)
small_sides = List.GetItemAtIndex(list=removeItemAtIndex, index=allIndicesOf_3)
Smallsidesurface = Output(small_sides)  # "Smallsidesurface:Surface"
long_sides = List.RemoveItemAtIndex(list=removeItemAtIndex, indices=allIndicesOf_3)
Longsidesurface = Output(long_sides)  # "Longsidesurface:Surface"
