# Dynamo custom node CleanPointsbyCurvatureandSegmenthLength.dyf (Dynamo 2.2.1.5175)
# category: PracticalBIM.Geometry.Points.RoallerCoaster
# Cleans a set of Points using a segmenth Length

points = Input(points: Autodesk.DesignScript.Geometry.Point[])
byControlPoints = NurbsCurve.ByControlPoints(points=points)
length = Curve.Length(curve=byControlPoints)
segmenthDistance = Input(segmenthDistance: double)
code_block = CodeBlock(v=length, d=segmenthDistance) { 0..v..d; }
addItemToEnd = List.AddItemToEnd(item=length, list=code_block)
pointAtSegmentLength = Curve.PointAtSegmentLength(curve=byControlPoints, segmentLength=addItemToEnd)
byControlPoints_2 = NurbsCurve.ByControlPoints(points=pointAtSegmentLength)
pointAtSegmentLength_2 = Curve.PointAtSegmentLength(curve=byControlPoints_2, segmentLength=addItemToEnd)
byPoints = NurbsCurve.ByPoints(points=pointAtSegmentLength_2)
NurbsCurve = Output(byPoints)
pointAtSegmentLength_3 = Curve.PointAtSegmentLength(curve=byPoints, segmentLength=addItemToEnd)
Point = Output(pointAtSegmentLength_3)  # "Point[]"
