# Dynamo custom node ClosedLoopThroughPointsonCurve.dyf (Dynamo 2.6.1.8786)
# category: PracticalBIM.Revit.Elements.Topography
# Gets a Loop of Points using a Curve

points = Input(points: Autodesk.DesignScript.Geometry.Point[])
boolean = BoolSelector(true)  # graph input
byPoints = PolyCurve.ByPoints(points=points, connectLastToFirst=boolean)
curves = PolyCurve.Curves(polyCurve=byPoints)
Curves = Output(curves)
