# Dynamo custom node ColortoInt.dyf (Dynamo 2.3.0.5885)
# category: PracticalBIM.Display.Transfer
# Converts a Color to Integer Value

color = Input(color: DSCore.Color)
red = Color.Red(color=color)
green = Color.Green(color=color)
code_block = CodeBlock(a=green) { a*256; }
blue = Color.Blue(color=color)
code_block_2 = CodeBlock(a=blue) { a*256*256; }
code_block_3 = CodeBlock(a=red, b=code_block, c=code_block_2) { a+b+c; }
number = Output(code_block_3)  # "number:int"
