# Dynamo custom node CombineList2TimesValues.dyf (Dynamo 2.5.0.7460)
# category: PracticalBIM.GD.Splits
# Create a Double Combination of values

listofvalues = Input(listofvalues: double[])
ge = listofvalues >= listofvalues  # lacing=CrossProduct
code_block = CodeBlock { true; }
allIndicesOf = List.AllIndicesOf(list=ge@L2, item=code_block)
getItemAtIndex = List.GetItemAtIndex(list=listofvalues, index=allIndicesOf)
code_block_2 = CodeBlock(a=listofvalues, b=getItemAtIndex) { a+b; }
flatten = List.Flatten(list=code_block_2)
flatten_2 = List.Flatten(list=getItemAtIndex)
ge_2 = flatten_2 >= listofvalues  # lacing=CrossProduct
allIndicesOf_2 = List.AllIndicesOf(list=ge_2@L2, item=code_block)
getItemAtIndex_2 = List.GetItemAtIndex(list=listofvalues, index=allIndicesOf_2)
add = flatten + getItemAtIndex_2
flatten_3 = List.Flatten(list=add)
flatten_4 = List.Flatten(list=flatten)
flatten_5 = List.Flatten(list=listofvalues)
join = List.Join(list0=flatten_3, list1=flatten_4, list2=flatten_5)
uniqueItems = List.UniqueItems(list=join)
sort = List.Sort(list=uniqueItems)
allIndicesOf_3 = List.AllIndicesOf(list=join, item=sort)
lastItem = List.LastItem(list=allIndicesOf_3@L2)
getItemAtIndex_3 = List.GetItemAtIndex(list=join, index=lastItem)
values = Output(getItemAtIndex_3)  # "values:double[]"
code_block_3 = CodeBlock(a=listofvalues, b=getItemAtIndex) { a+"_"+b; }
flatten_6 = List.Flatten(list=code_block_3)
code_block_4 = CodeBlock(a=flatten_6) { a+"_"; }
add_2 = code_block_4 + getItemAtIndex_2
flatten_7 = List.Flatten(list=add_2)
flatten_8 = List.Flatten(list=flatten_6)
flatten_9 = List.Flatten(list=listofvalues)
join_2 = List.Join(list0=flatten_7, list1=flatten_8, list2=flatten_9)
getItemAtIndex_4 = List.GetItemAtIndex(list=join_2, index=lastItem)
string_from_object = FromObject(obj=getItemAtIndex_4)
code_block_5 = CodeBlock { "_"; }
split = String.Split(str=string_from_object, separator0=code_block_5)
toNumber = String.ToNumber(str=split)
Items = Output(toNumber)  # "Items:double[]..[]"
