# Dynamo custom node CreateBlocksofGridswithNames.dyf (Dynamo 2.2.1.5175)
# category: PracticalBIM.4dSimulation
# Creates Blocks of Grids with their Names

element_types = ElementTypes("Grid")
all_elements_of_type = ElementsOfType(element_type=element_types)
name = Element.Name(element=all_elements_of_type)
curve = Grid.Curve(grid=all_elements_of_type)
direction = Line.Direction(line=curve)
normalized = Vector.Normalized(vector=direction)
string_from_object = FromObject(obj=normalized)
uniqueItems = List.UniqueItems(list=string_from_object)
allIndicesOf = List.AllIndicesOf(list=string_from_object, item=uniqueItems)
getItemAtIndex = List.GetItemAtIndex(list=name, index=allIndicesOf)
code_block = CodeBlock { 0; }
getItemAtIndex_2 = List.GetItemAtIndex(list=getItemAtIndex, index=code_block)
gridCombinationNames = Custom[GridCombinationNames](list=getItemAtIndex_2)  # Gets the Grid Combination Names for Block of Zone
code_block_2 = CodeBlock(a=gridCombinationNames) { a+"/"; }
code_block_3 = CodeBlock { 1; }
getItemAtIndex_3 = List.GetItemAtIndex(list=getItemAtIndex, index=code_block_3)
gridCombinationNames_2 = Custom[GridCombinationNames](list=getItemAtIndex_3)
add = code_block_2 + gridCombinationNames_2  # lacing=CrossProduct
flatten = List.Flatten(list=add)
NamesofBlockGrids = Output(flatten)  # "NamesofBlockGrids:string[]"
startPoint = Curve.StartPoint(curve=curve)
X = Point.X(point=startPoint)
endPoint = Curve.EndPoint(curve=curve)
X_2 = Point.X(point=endPoint)
join = List.Join(list0=X, list1=X_2)
minimumItem = List.MinimumItem(list=join)
Y = Point.Y(point=startPoint)
Y_2 = Point.Y(point=endPoint)
join_2 = List.Join(list0=Y, list1=Y_2)
minimumItem_2 = List.MinimumItem(list=join_2)
element_types_2 = ElementTypes("Level")
all_elements_of_type_2 = ElementsOfType(element_type=element_types_2)
elevation = Level.Elevation(level=all_elements_of_type_2)
minimumItem_3 = List.MinimumItem(list=elevation)
code_block_4 = CodeBlock(a=minimumItem_3) { a-5; }
byCoordinates = Point.ByCoordinates(x=minimumItem, y=minimumItem_2, z=code_block_4)
maximumItem = List.MaximumItem(list=join)
maximumItem_2 = List.MaximumItem(list=join_2)
maximumItem_3 = List.MaximumItem(list=elevation)
code_block_5 = CodeBlock(a=maximumItem_3) { a+5; }
byCoordinates_2 = Point.ByCoordinates(x=maximumItem, y=maximumItem_2, z=code_block_5)
byCorners = Cuboid.ByCorners(lowPoint=byCoordinates, highPoint=byCoordinates_2)
code_block_6 = CodeBlock { 0.5; }
pointAtParameter = Curve.PointAtParameter(curve=curve, param=code_block_6)
byCoordinates_3 = Vector.ByCoordinates(z=code_block_5)
translate = Geometry.Translate(geometry=pointAtParameter, direction=byCoordinates_3)
byLineAndPoint = Plane.ByLineAndPoint(line=curve, point=translate)
getItemAtIndex_4 = List.GetItemAtIndex(list=byLineAndPoint, index=allIndicesOf)
getItemAtIndex_5 = List.GetItemAtIndex(list=getItemAtIndex_4, index=code_block)
splitSolidbyPlanes = Custom[SplitSolidbyPlanes](solidtodivide=byCorners, planesfordivision=getItemAtIndex_5)  # Splits a Solid element by Planes sorted
getItemAtIndex_6 = List.GetItemAtIndex(list=getItemAtIndex_4, index=code_block_3)
splitSolidbyPlanes_2 = Custom[SplitSolidbyPlanes](solidtodivide=splitSolidbyPlanes, planesfordivision=getItemAtIndex_6)
flatten_2 = List.Flatten(list=splitSolidbyPlanes_2)
Blockgrids = Output(flatten_2)  # "Blockgrids:Solid[]"
