# Dynamo custom node CreateConveyourByCoordinateSystemWidthandHeigth4.dyf (Dynamo 2.2.1.5175)
# category: PracticalBIM.Geometry.Structure.Modules
# Creates a Conveyour by a coordinate system width and heigth

cordinatesystems = Input(cordinatesystems: Autodesk.DesignScript.Geometry.CoordinateSystem[])
width = Input(width: double)
leftBottom = Point.ByCartesianCoordinates(cs=cordinatesystems, x=width)
code_block = CodeBlock { [1,2]; }
getItemAtIndex = List.GetItemAtIndex(list=leftBottom, index=code_block)
heigth = Input(heigth: double)
leftTop = Point.ByCartesianCoordinates(cs=cordinatesystems, x=width, y=heigth)
code_block_2 = CodeBlock { [2,3]; }
getItemAtIndex_2 = List.GetItemAtIndex(list=leftTop, index=code_block_2)
byStartPointEndPoint = Line.ByStartPointEndPoint(startPoint=getItemAtIndex, endPoint=getItemAtIndex_2)
code_block_3 = CodeBlock(a=width) { -a; }
rigthBottom = Point.ByCartesianCoordinates(cs=cordinatesystems, x=code_block_3)
code_block_4 = CodeBlock { [1,2]; }
getItemAtIndex_3 = List.GetItemAtIndex(list=rigthBottom, index=code_block_4)
rigth_top = Point.ByCartesianCoordinates(cs=cordinatesystems, x=code_block_3, y=heigth)
code_block_5 = CodeBlock { [2,3]; }
getItemAtIndex_4 = List.GetItemAtIndex(list=rigth_top, index=code_block_5)
byStartPointEndPoint_2 = Line.ByStartPointEndPoint(startPoint=getItemAtIndex_3, endPoint=getItemAtIndex_4)
code_block_6 = CodeBlock { [1,2]; }
getItemAtIndex_5 = List.GetItemAtIndex(list=rigthBottom, index=code_block_6)
code_block_7 = CodeBlock { [0,1]; }
getItemAtIndex_6 = List.GetItemAtIndex(list=rigth_top, index=code_block_7)
byStartPointEndPoint_3 = Line.ByStartPointEndPoint(startPoint=getItemAtIndex_5, endPoint=getItemAtIndex_6)
code_block_8 = CodeBlock { [1,2]; }
getItemAtIndex_7 = List.GetItemAtIndex(list=leftBottom, index=code_block_8)
code_block_9 = CodeBlock { [0,1]; }
getItemAtIndex_8 = List.GetItemAtIndex(list=leftTop, index=code_block_9)
byStartPointEndPoint_4 = Line.ByStartPointEndPoint(startPoint=getItemAtIndex_7, endPoint=getItemAtIndex_8)
diagonals = List.Create(item0=byStartPointEndPoint, item1=byStartPointEndPoint_2, item2=byStartPointEndPoint_3, item3=byStartPointEndPoint_4)
flatten = List.Flatten(list=diagonals)
diagonals_2 = Output(flatten)  # "diagonals:Curve[]"
byStartPointEndPoint_5 = Line.ByStartPointEndPoint(startPoint=leftBottom, endPoint=rigthBottom)
byStartPointEndPoint_6 = Line.ByStartPointEndPoint(startPoint=leftTop, endPoint=rigth_top)
linesFromListofPoints = Custom[LinesFromListofPoints](list=leftBottom)  # Gets a secuence of Lines from a list of Points
linesFromListofPoints_2 = Custom[LinesFromListofPoints](list=rigthBottom)
linesFromListofPoints_3 = Custom[LinesFromListofPoints](list=leftTop)
linesFromListofPoints_4 = Custom[LinesFromListofPoints](list=rigth_top)
framings = List.Create(item0=byStartPointEndPoint_5, item1=byStartPointEndPoint_6, item2=linesFromListofPoints, item3=linesFromListofPoints_2, item4=linesFromListofPoints_3, item5=linesFromListofPoints_4)
flatten_2 = List.Flatten(list=framings)
framings_2 = Output(flatten_2)  # "framings:Curve[]"
byStartPointEndPoint_7 = Line.ByStartPointEndPoint(startPoint=leftBottom, endPoint=leftTop)
byStartPointEndPoint_8 = Line.ByStartPointEndPoint(startPoint=rigthBottom, endPoint=rigth_top)
columns = List.Create(item0=byStartPointEndPoint_7, item1=byStartPointEndPoint_8)
flatten_3 = List.Flatten(list=columns)
columns_2 = Output(flatten_3)  # "columns:Curve[]"
