# Dynamo custom node CreateFiltersonSchedulesbyStringandValue.dyf (Dynamo 2.2.1.5175)
# category: PracticalBIM.Revit.View.Schedules
# Create Filters on Schedules by a String and a Value

scheduleView = Input(scheduleView: Revit.Elements.Views.ScheduleView[])
fields = ScheduleView.Fields(scheduleView=scheduleView)
name = Revit.Schedules.ScheduleField.Name(scheduleField=fields)
FieldtocreateFilter = Input(FieldtocreateFilter: string)
allIndicesOf = List.AllIndicesOf(list=name@L2, item=FieldtocreateFilter)
getItemAtIndex = List.GetItemAtIndex(list=fields@L2, index=allIndicesOf@L2)
code_block = CodeBlock { "Equal"; }
comparisonValue = Input(comparisonValue: string)
byFieldTypeAndValue = Revit.Schedules.ScheduleFilter.ByFieldTypeAndValue(field=getItemAtIndex@L2, filterType=code_block, value=comparisonValue, lacing=Longest)
addFilters = ScheduleView.AddFilters(scheduleView=scheduleView, scheduleFilters=byFieldTypeAndValue)
scheduleView_2 = Output(addFilters)  # "scheduleView:ScheduleView[]"
