# Dynamo custom node CreateFloorbylevelusingtwosetsofpoints.dyf (Dynamo 2.2.1.5175)
# category: PracticalBIM.Revit.Elements.Floor
# Creates a Floor By Level and type using two sets of points

firstsetpoints = Input(firstsetpoints: Autodesk.DesignScript.Geometry.Point[])
X = Point.X(point=firstsetpoints)
Y = Point.Y(point=firstsetpoints)
level = Input(level: Revit.Elements.Level)
elevation = Level.Elevation(level=level)
byCoordinates = Point.ByCoordinates(x=X, y=Y, z=elevation)
byPoints = NurbsCurve.ByPoints(points=byCoordinates)
secondsetpoints = Input(secondsetpoints: Autodesk.DesignScript.Geometry.Point[])
X_2 = Point.X(point=secondsetpoints)
Y_2 = Point.Y(point=secondsetpoints)
byCoordinates_2 = Point.ByCoordinates(x=X_2, y=Y_2, z=elevation)
byPoints_2 = NurbsCurve.ByPoints(points=byCoordinates_2)
join = List.Join(list0=byPoints, list1=byPoints_2)
byLoft = Surface.ByLoft(crossSections=join)
perimeterCurves = Surface.PerimeterCurves(surface=byLoft)
floorType = Input(floorType: Revit.Elements.FloorType)
byOutlineTypeAndLevel = Floor.ByOutlineTypeAndLevel(outlineCurves=perimeterCurves, floorType=floorType, level=level)
Floor = Output(byOutlineTypeAndLevel)
