# Dynamo custom node CreateIntervalstoEvaluate.dyf (Dynamo 2.2.1.5175)
# category: PracticalBIM.Analysis.Time
# Creates Intervals to Evaluate Dates

startdateasinteger = Input(startdateasinteger: int)
string_from_object = FromObject(obj=startdateasinteger)
code_block = CodeBlock { 0; }
code_block_2 = CodeBlock { 2; }
substring = String.Substring(str=string_from_object, startIndex=code_block, length=code_block_2)
toNumber = String.ToNumber(str=substring)
code_block_3 = CodeBlock { 2; }
substring_2 = String.Substring(str=string_from_object, startIndex=code_block_3, length=code_block_2)
toNumber_2 = String.ToNumber(str=substring_2)
code_block_4 = CodeBlock { 4; }
substring_3 = String.Substring(str=string_from_object, startIndex=code_block_4, length=code_block_2)
toNumber_3 = String.ToNumber(str=substring_3)
byDate = DateTime.ByDate(year=toNumber, month=toNumber_2, day=toNumber_3)
enddateasinteger = Input(enddateasinteger: int)
string_from_object_2 = FromObject(obj=enddateasinteger)
code_block_5 = CodeBlock { 0; }
code_block_6 = CodeBlock { 2; }
substring_4 = String.Substring(str=string_from_object_2, startIndex=code_block_5, length=code_block_6)
toNumber_4 = String.ToNumber(str=substring_4)
code_block_7 = CodeBlock { 2; }
substring_5 = String.Substring(str=string_from_object_2, startIndex=code_block_7, length=code_block_6)
toNumber_5 = String.ToNumber(str=substring_5)
code_block_8 = CodeBlock { 4; }
substring_6 = String.Substring(str=string_from_object_2, startIndex=code_block_8, length=code_block_6)
toNumber_6 = String.ToNumber(str=substring_6)
byDate_2 = DateTime.ByDate(year=toNumber_4, month=toNumber_5, day=toNumber_6)
byDateDifference = TimeSpan.ByDateDifference(date1=byDate_2, date2=byDate)
totalDays = TimeSpan.TotalDays(timeSpan=byDateDifference)
daysofinterval = Input(daysofinterval: int)
code_block_9 = CodeBlock(b=totalDays, n=daysofinterval) { 0..b..n; }
create = TimeSpan.Create(days=code_block_9)
addTimeSpan = DateTime.AddTimeSpan(dateTime=byDate, timeSpan=create)
flattentoNavisworkstime = Custom[FlattentoNavisworkstime](DateTimesto=addTimeSpan)  # Flatten DateTime to a Format for Navisworks
parsingDatedd_mm_yyyytoDateTimeandString = Custom[ParsingDatedd_mm_yyyytoDateTimeandString](strwithFormat=flattentoNavisworkstime)  # Parsing Date to Time and String
dateTime = Output(parsingDatedd_mm_yyyytoDateTimeandString.dateTime)
DatestringforInteger = Output(parsingDatedd_mm_yyyytoDateTimeandString.DatestringforInteger)
