# Dynamo custom node CreateLegendGridbyNWL.dyf (Dynamo 2.2.1.5175)
# category: PracticalBIM.Revit.View.Drafting
# Creates a Legend Grid by Number of elements Width and Length

length = Input(length: double)
code_block = CodeBlock(a=length) { 0..(a*2)..a; }
count = Input(count: int)
width = Input(width: double)
code_block_2 = CodeBlock(a=count, b=width) { 0..((a+1)*-b)..-b; }
byCoordinates = Point.ByCoordinates(x=code_block, y=code_block_2, lacing=CrossProduct)
Point = Output(byCoordinates)  # "Point[]"
code_block_3 = CodeBlock(a=byCoordinates) { a[0]; }
byBestFitThroughPoints = Line.ByBestFitThroughPoints(bestFitPoints=code_block_3)
code_block_4 = CodeBlock(a=byCoordinates) { a[1]; }
code_block_5 = CodeBlock { 0; }
removeItemAtIndex = List.RemoveItemAtIndex(list=code_block_4, indices=code_block_5)
byBestFitThroughPoints_2 = Line.ByBestFitThroughPoints(bestFitPoints=removeItemAtIndex)
code_block_6 = CodeBlock(a=byCoordinates) { a[2]; }
byBestFitThroughPoints_3 = Line.ByBestFitThroughPoints(bestFitPoints=code_block_6)
transpose = List.Transpose(lists=byCoordinates)
byBestFitThroughPoints_4 = Line.ByBestFitThroughPoints(bestFitPoints=transpose)
join = List.Join(list0=byBestFitThroughPoints, list1=byBestFitThroughPoints_2, list2=byBestFitThroughPoints_3, list3=byBestFitThroughPoints_4)
list = Output(join)  # "list[]"
