# Dynamo custom node CreatePointsbyDistanceStations.dyf (Dynamo 2.2.1.5175)
# category: PracticalBIM.Geometry.Curves
# Creates Points at a given distance

pointstosetstations = Input(pointstosetstations: Autodesk.DesignScript.Geometry.Point[])
byControlPoints = NurbsCurve.ByControlPoints(points=pointstosetstations)
length = Curve.Length(curve=byControlPoints)
CurveLength = Output(length)  # "CurveLength:double"
distancebetweenstations = Input(distancebetweenstations: double)
code_block = CodeBlock(l=length, n=distancebetweenstations) { 0..l..n; }
addItemToEnd = List.AddItemToEnd(item=length, list=code_block)
pointAtSegmentLength = Curve.PointAtSegmentLength(curve=byControlPoints, segmentLength=addItemToEnd)
StationPoints = Output(pointAtSegmentLength)  # "StationPoints:Point[]"
