# Dynamo custom node CreateSurfacesbyCreationLines.dyf (Dynamo 2.6.1.8786)
# category: PracticalBIM.Geometry.Surfaces
# Create Surfaces by Sorted Creation Lines
# packages: PracticalBIM 2020.0.29

LinesX = Input(LinesX: var[]..[])
flatten = List.Flatten(list=LinesX)
code_block = CodeBlock { 0.5; }
pointAtParameter = Curve.PointAtParameter(curve=flatten, param=code_block)
Y = Point.Y(point=pointAtParameter)
groupByKey = List.GroupByKey(list=flatten, keys=Y)
removeLast = Custom[RemoveLast](list=groupByKey.groups@L2)  # package PracticalBIM; Remove Last element of a List
flatten_2 = List.Flatten(list=removeLast)
restOfItems = List.RestOfItems(list=groupByKey.groups@L2)
flatten_3 = List.Flatten(list=restOfItems)
list_create = List.Create(item0=flatten_2, item1=flatten_3)
transpose = List.Transpose(lists=list_create)
byLoft = Surface.ByLoft(crossSections=transpose)
Surfaces = Output(byLoft)  # "Surfaces:Surface"
string_from_object = FromObject(obj=flatten)
string_from_object_2 = FromObject(obj=transpose)
allIndicesOf = List.AllIndicesOf(list=string_from_object, item=string_from_object_2)
code_block_2 = CodeBlock { 1; }
flatten_4 = List.Flatten(list=allIndicesOf@L3, amt=code_block_2)
getItemAtIndex = List.GetItemAtIndex(list=flatten, index=flatten_4)
LinesX_2 = Output(getItemAtIndex)  # "LinesX:Line"
LinesY = Input(LinesY: var[]..[])
flatten_5 = List.Flatten(list=LinesY)
string_from_object_3 = FromObject(obj=flatten_5)
code_block_3 = CodeBlock { 0.5; }
pointAtParameter_2 = Curve.PointAtParameter(curve=flatten_5, param=code_block_3)
X = Point.X(point=pointAtParameter_2)
groupByKey_2 = List.GroupByKey(list=flatten_5, keys=X)
removeLast_2 = Custom[RemoveLast](list=groupByKey_2.groups@L2)
flatten_6 = List.Flatten(list=removeLast_2)
restOfItems_2 = List.RestOfItems(list=groupByKey_2.groups@L2)
flatten_7 = List.Flatten(list=restOfItems_2)
list_create_2 = List.Create(item0=flatten_6, item1=flatten_7)
transpose_2 = List.Transpose(lists=list_create_2)
string_from_object_4 = FromObject(obj=transpose_2)
allIndicesOf_2 = List.AllIndicesOf(list=string_from_object_3, item=string_from_object_4)
code_block_4 = CodeBlock { 1; }
flatten_8 = List.Flatten(list=allIndicesOf_2@L3, amt=code_block_4)
getItemAtIndex_2 = List.GetItemAtIndex(list=flatten_5, index=flatten_8)
code_block_5 = CodeBlock { 0.5; }
pointAtParameter_3 = Surface.PointAtParameter(surface=byLoft, u=code_block_5, v=code_block_5)
string_from_object_5 = FromObject(obj=pointAtParameter_3)
byLoft_2 = Surface.ByLoft(crossSections=transpose_2)
pointAtParameter_4 = Surface.PointAtParameter(surface=byLoft_2, u=code_block_5, v=code_block_5)
string_from_object_6 = FromObject(obj=pointAtParameter_4)
indexOf = List.IndexOf(list=string_from_object_5, element=string_from_object_6)
getItemAtIndex_3 = List.GetItemAtIndex(list=getItemAtIndex_2, index=indexOf)
LinesY_2 = Output(getItemAtIndex_3)  # "LinesY:int"
