# Dynamo custom node CreateblocksofProximitybyDistance.dyf (Dynamo 2.2.1.5175)
# category: PracticalBIM.GN
# Creates Blocks of Proximity by Distance by points

listofpoints = Input(listofpoints: Autodesk.DesignScript.Geometry.Point[])
X = Point.X(point=listofpoints)
code_block = CodeBlock { 1; }
maximumItem = List.MaximumItem(list=X)
minimumItem = List.MinimumItem(list=X)
code_block_2 = CodeBlock(a=maximumItem, b=minimumItem) { a-b; }
divisiondistance = Input(divisiondistance: double)
code_block_3 = CodeBlock(a=code_block_2, n=divisiondistance) { a/n; }
code_block_4 = CodeBlock { 0; }
round = Math.Round(number=code_block_3, digits=code_block_4)
remapRange = Math.RemapRange(numbers=X, newMin=code_block, newMax=round)
code_block_5 = CodeBlock { 0; }
round_2 = Math.Round(number=remapRange, digits=code_block_5)
string_from_object = FromObject(obj=round_2)
code_block_6 = CodeBlock { 0; }
code_block_7 = CodeBlock { "."; }
indexOf = String.IndexOf(str=string_from_object, searchFor=code_block_7)
substring = String.Substring(str=string_from_object, startIndex=code_block_6, length=indexOf)
Y = Point.Y(point=listofpoints)
maximumItem_2 = List.MaximumItem(list=Y)
minimumItem_2 = List.MinimumItem(list=Y)
code_block_8 = CodeBlock(a=maximumItem_2, b=minimumItem_2) { a-b; }
code_block_9 = CodeBlock(a=code_block_8, n=divisiondistance) { a/n; }
code_block_10 = CodeBlock { 0; }
round_3 = Math.Round(number=code_block_9, digits=code_block_10)
remapRange_2 = Math.RemapRange(numbers=Y, newMin=code_block, newMax=round_3)
code_block_11 = CodeBlock { 0; }
round_4 = Math.Round(number=remapRange_2, digits=code_block_11)
string_from_object_2 = FromObject(obj=round_4)
code_block_12 = CodeBlock { 0; }
code_block_13 = CodeBlock { "."; }
indexOf_2 = String.IndexOf(str=string_from_object_2, searchFor=code_block_13)
substring_2 = String.Substring(str=string_from_object_2, startIndex=code_block_12, length=indexOf_2)
Z = Point.Z(point=listofpoints)
maximumItem_3 = List.MaximumItem(list=Z)
minimumItem_3 = List.MinimumItem(list=Z)
code_block_14 = CodeBlock(a=maximumItem_3, b=minimumItem_3) { a-b; }
code_block_15 = CodeBlock(a=code_block_14, n=divisiondistance) { a/n; }
code_block_16 = CodeBlock { 0; }
round_5 = Math.Round(number=code_block_15, digits=code_block_16)
remapRange_3 = Math.RemapRange(numbers=Z, newMin=code_block, newMax=round_5)
code_block_17 = CodeBlock { 0; }
round_6 = Math.Round(number=remapRange_3, digits=code_block_17)
string_from_object_3 = FromObject(obj=round_6)
code_block_18 = CodeBlock { 0; }
code_block_19 = CodeBlock { "."; }
indexOf_3 = String.IndexOf(str=string_from_object_3, searchFor=code_block_19)
substring_3 = String.Substring(str=string_from_object_3, startIndex=code_block_18, length=indexOf_3)
code_block_20 = CodeBlock(a=substring, b=substring_2, c=substring_3) { a+"_"+b+"_"+c; }
groupByKey = List.GroupByKey(list=listofpoints, keys=code_block_20)
X_2 = Point.X(point=groupByKey.groups)
Y_2 = Point.Y(point=groupByKey.groups)
Z_2 = Point.Z(point=groupByKey.groups)
code_block_21 = CodeBlock { 0; }
cuboidbyMinandMaxofPointValues = Custom[CuboidbyMinandMaxofPointValues](PointXValue=X_2, PointYvalue=Y_2, PointZValue=Z_2, AdditionalLowerValue=code_block_21, AdditionalUpperValue=code_block_21)  # Creates a Cuboid by Minimun and Maximum values with XYZ and aditional values
ResultingCuboid = Output(cuboidbyMinandMaxofPointValues)  # "ResultingCuboid:Geometry.Solid[]"
