# Dynamo custom node CropBoxResize.dyf (Dynamo 2.2.1.5175)
# category: PracticalBIM.Revit.View
# Changes the size of a cropbox by distance units

view = Input(view: var[]..[])
create = List.Create(item0=view)
flatten = List.Flatten(list=create)
amt = Input(amt: double)
byCoordinates = Point.ByCoordinates(x=amt, y=amt, z=amt)
python_script = Python(IN[0]=flatten, IN[1]=byCoordinates)
# ---------- python_script.python (33 lines) ----------
import clr
clr.AddReference('RevitAPI')
from Autodesk.Revit.DB import *

clr.AddReference("RevitNodes")
import Revit
clr.ImportExtensions(Revit.GeometryConversion)

clr.AddReference("RevitServices")
import RevitServices
from RevitServices.Persistence import DocumentManager
from RevitServices.Transactions import TransactionManager

doc = DocumentManager.Instance.CurrentDBDocument
views = UnwrapElement(IN[0])
margin = IN[1].ToXyz()
booleans = []

TransactionManager.Instance.EnsureInTransaction(doc)
for item in views:
	try:
		newmax = item.CropBox.Max.Add(margin)
		newmin = item.CropBox.Min.Subtract(margin)
		newbox = BoundingBoxXYZ()
		newbox.Max = newmax
		newbox.Min = newmin
		item.CropBox = newbox
		booleans.append(True)
	except:
		booleans.append(False)
TransactionManager.Instance.TransactionTaskDone()

OUT = (views,booleans)
# ----------------------------------------
firstItem = List.FirstItem(list=python_script)
python_script_2 = Python(IN[0]=view, IN[1]=firstItem)
# ---------- python_script_2.python (4 lines) ----------
check = IN[0]
items = IN[1]
if isinstance(check, (list)): OUT = items
else: OUT = items[0]
# ----------------------------------------
view_2 = Output(python_script_2)  # "view"
lastItem = List.LastItem(list=python_script)
python_script_3 = Python(IN[0]=view, IN[1]=lastItem)  # same code as python_script_2
success = Output(python_script_3)
