# Dynamo custom node CurvetoLine.dyf (Dynamo 2.2.1.5175)
# category: PracticalBIM.Geometry.Curves
# Transform a Curve to a Line by StartPoint EndPoint

curve = Input(curve: Autodesk.DesignScript.Geometry.Curve[])
startPoint = Curve.StartPoint(curve=curve)
endPoint = Curve.EndPoint(curve=curve)
byStartPointEndPoint = Line.ByStartPointEndPoint(startPoint=startPoint, endPoint=endPoint)
Line = Output(byStartPointEndPoint)  # "Line[]"
