# Dynamo custom node DistributeOptimalElementsandSetLocations.dyf (Dynamo 2.3.0.5885)
# category: PracticalBIM.GD.Splits
# Distribute Elements by Length setting locations

ListofLengthsthatcomposethat = Input(ListofLengthsthatcomposethat: double[])
LengthofElementstotest = Input(LengthofElementstotest: double)
LengthsAvailable = Input(LengthsAvailable: double[])
gt = LengthofElementstotest > LengthsAvailable
code_block = CodeBlock { true; }
allIndicesOf = List.AllIndicesOf(list=gt@L2, item=code_block)
lastItem = List.LastItem(list=allIndicesOf@L2)
getItemAtIndex = List.GetItemAtIndex(list=ListofLengthsthatcomposethat@L3, index=lastItem@L1)
item = Output(getItemAtIndex)
additionaladjustment = Input(additionaladjustment: double)
getItemAtIndex_2 = List.GetItemAtIndex(list=LengthsAvailable@L2, index=lastItem@L1)
code_block_2 = CodeBlock(a=LengthofElementstotest, b=getItemAtIndex_2) { a-b; }
ajuste_de_piezas = CodeBlock(a=additionaladjustment, b=code_block_2) { a+b; }
code_block_3 = CodeBlock(a=ajuste_de_piezas) { a/2; }
count = List.Count(list=getItemAtIndex@L2)
code_block_4 = CodeBlock(n=count) { 1..#n..1; }
code_block_5 = CodeBlock(n=code_block_4) { 0..#n..1; }
getItemAtIndex_3 = List.GetItemAtIndex(list=getItemAtIndex@L2, index=code_block_5@L3)
sum = Math.Sum(values=getItemAtIndex_3)
code_block_6 = CodeBlock(a=code_block_3, b=sum) { a+b; }
addItemToFront = List.AddItemToFront(item=code_block_3@L1, list=code_block_6@L2)
list = Output(addItemToFront)
