# Dynamo custom node DuplicateView.dyf (Dynamo 2.2.1.5175)
# category: PracticalBIM.Revit.View
# Creates a Duplicate from any View

SelectecViews = Input(SelectecViews: var[]..[])
NewNames = Input(NewNames: string[]..[])
python_script = Python(IN[0]=SelectecViews, IN[1]=NewNames)
# ---------- python_script.python (32 lines) ----------
import clr
clr.AddReference('RevitAPI')
from Autodesk.Revit.DB import *
import Autodesk

clr.AddReference("RevitServices")
import RevitServices
from RevitServices.Persistence import DocumentManager
from RevitServices.Transactions import TransactionManager

def DuplicateView(view, name, doc):
	try:
		newViewId = view.Duplicate(Autodesk.Revit.DB.ViewDuplicateOption.Duplicate)
		newView = doc.GetElement(newViewId)
		try: newView.Name = name
		except: pass
		return newView
	except: return None

doc = DocumentManager.Instance.CurrentDBDocument
views = UnwrapElement(IN[0])

TransactionManager.Instance.EnsureInTransaction(doc)
if isinstance(IN[0], list):
	OUT = []
	for view, name in zip(views, IN[1]):
		if isinstance(name, list): OUT.append([DuplicateView(view, x, doc) for x in name])
		else: OUT.append(DuplicateView(view, name, doc))
else: 
	if isinstance(IN[1], list): OUT = [DuplicateView(views, x, doc) for x in IN[1]]
	else: OUT = DuplicateView(views, IN[1], doc)
TransactionManager.Instance.TransactionTaskDone()
# ----------------------------------------
view = Output(python_script)
