# Dynamo custom node ExtractingConduitConnectorValues.dyf (Dynamo 2.2.1.5175)
# category: PracticalBIM.Revit.Elements.MEP.Connectors
# Extract from the Connector Node Conduit Connector Values

Pointvalues = Input(Pointvalues: Autodesk.DesignScript.Geometry.Point[])
ConnectorSystemType = Input(ConnectorSystemType: var[])
isNull = Object.IsNull(obj=ConnectorSystemType)
code_block = CodeBlock { true; }
allIndicesOf = List.AllIndicesOf(list=isNull, item=code_block)
getItemAtIndex = List.GetItemAtIndex(list=Pointvalues, index=allIndicesOf)
ConduitPoints = Output(getItemAtIndex)  # "ConduitPoints:Point[]"
Vectorvalues = Input(Vectorvalues: Autodesk.DesignScript.Geometry.Vector[])
getItemAtIndex_2 = List.GetItemAtIndex(list=Vectorvalues, index=allIndicesOf)
ConduitVectors = Output(getItemAtIndex_2)  # "ConduitVectors:Vector[]"
RadiusValues = Input(RadiusValues: double[])
getItemAtIndex_3 = List.GetItemAtIndex(list=RadiusValues, index=allIndicesOf)
ConduitRadius = Output(getItemAtIndex_3)  # "ConduitRadius:double[]"
ConectorValues = Input(ConectorValues: var[])
getItemAtIndex_4 = List.GetItemAtIndex(list=ConectorValues, index=allIndicesOf)
ConduitConnector = Output(getItemAtIndex_4)  # "ConduitConnector:var[]"
