# Dynamo custom node FaceMeshVertices.dyf (Dynamo 2.6.1.8786)
# category: PracticalBIM.Revit.Elements.Topography
# Creates a Face Mesh Vertices Creation

mesh = Input(mesh: Autodesk.DesignScript.Geometry.Mesh)
vertexPositions = Mesh.VertexPositions(mesh=mesh)
faceIndices = Mesh.FaceIndices(mesh=mesh)
A = IndexGroup.A(indexGroup=faceIndices)
getItemAtIndex = List.GetItemAtIndex(list=vertexPositions, index=A)
B = IndexGroup.B(indexGroup=faceIndices)
getItemAtIndex_2 = List.GetItemAtIndex(list=vertexPositions, index=B)
C = IndexGroup.C(indexGroup=faceIndices)
getItemAtIndex_3 = List.GetItemAtIndex(list=vertexPositions, index=C)
create = List.Create(item0=getItemAtIndex, item1=getItemAtIndex_2, item2=getItemAtIndex_3)
transpose = List.Transpose(lists=create)
vertices = Output(transpose)
