# Dynamo custom node FamilyTypesandNamesfromFamilyName.dyf (Dynamo 2.3.0.5885)
# category: PracticalBIM.Revit.Elements.Family
# Gets all Family Types by Family Names

FamilyName = Input(FamilyName: string[])
byName = Family.ByName(name=FamilyName)
types = Family.Types(family=byName)
flatten = List.Flatten(list=types)
name = FamilyType.Name(familyType=flatten)
keys = Output(name)  # "keys:string"
count = List.Count(list=name)
code_block = CodeBlock(n=count) { 0..#n..1; }
values = Output(code_block)  # "values:int"
FamilyTypes = Output(flatten)  # "FamilyTypes:FamilyType"
