# Dynamo custom node FilterElementsbyParameterandValue.dyf (Dynamo 2.3.0.5885)
# category: PracticalBIM.Revit.Elements.Element
# Filters all Elements by Parameter and value

element = Input(element: Revit.Elements.Element[])
parameterName = Input(parameterName: string)
getParameterValueByName = Element.GetParameterValueByName(element=element, parameterName=parameterName)
FilterValue = Input(FilterValue: var)
allIndicesOf = List.AllIndicesOf(list=getParameterValueByName, item=FilterValue)
getItemAtIndex = List.GetItemAtIndex(list=element, index=allIndicesOf)
FilteredElements = Output(getItemAtIndex)  # "FilteredElements:Element"
