# Dynamo custom node FloorbyFramings.dyf (Dynamo 2.5.0.7460)
# category: PracticalBIM.Revit.Elements.Floor
# Creates a Floor By Framings
# packages: PracticalBIM 2020.0.23

listoflines = Input(listoflines: Autodesk.DesignScript.Geometry.Line[]..[])
removeLast = Custom[RemoveLast](list=listoflines@L3)  # package PracticalBIM; Remove Last element of a List
flatten = List.Flatten(list=removeLast)
restOfItems = List.RestOfItems(list=listoflines@L3)
flatten_2 = List.Flatten(list=restOfItems)
list_create = List.Create(item0=flatten, item1=flatten_2)
transpose = List.Transpose(lists=list_create)
byLoft = Surface.ByLoft(crossSections=transpose)
perimeterCurves = Surface.PerimeterCurves(surface=byLoft)
byJoinedCurves = PolyCurve.ByJoinedCurves(curves=perimeterCurves)
count = List.Count(list=removeLast@L2)
firstItem = List.FirstItem(list=count)
count_2 = List.Count(list=removeLast@L3)
firstItem_2 = List.FirstItem(list=count_2)
code_block = CodeBlock(A=firstItem, B=firstItem_2) { A*B; }
chop = List.Chop(list=byJoinedCurves, lengths=code_block)
floorType = Input(floorType: Revit.Elements.FloorType)
level = Input(level: Revit.Elements.Level)
byOutlineTypeAndLevel = Floor.ByOutlineTypeAndLevel(outline=chop, floorType=floorType, level=level)
endfloors = Output(byOutlineTypeAndLevel)  # "endfloors:Floor[]"
