# Dynamo custom node GenericOverrideColorinViewbyGeometry.dyf (Dynamo 2.2.1.5175)
# category: PracticalBIM.Geometry.Modifiers
# Creates a Generic Override Color in View by Geometry

geometry = Input(geometry: var[])
list = Input(list: var[])
count = List.Count(list=list)
code_block = CodeBlock(n=count) { 0..1..#n; }
color_range = ColorRange(value=code_block)  # unwired: colors, indices
byGeometryColor = Modifiers.GeometryColor.ByGeometryColor(geometry=geometry, color=color_range)
Geometry = Output(byGeometryColor)  # "Geometry[]"
Color = Output(color_range)
