# Dynamo custom node GetAllElementsbyFamilyName.dyf (Dynamo 2.6.1.8786)
# category: PracticalBIM.Revit.Selection
# Gets all Elements on the Model by Family Name

Familyname = Input(Familyname: string[])
byName = Family.ByName(name=Familyname)
types = Family.Types(family=byName)
all_elements_of_family_type = ElementsOfFamilyType(Family_Type=types)
flatten = List.Flatten(list=all_elements_of_family_type)
code_block = CodeBlock { false; }
clean = List.Clean(list=flatten, preserveIndices=code_block)
FamilyElements = Output(clean)  # "FamilyElements:Elements"
