# Dynamo custom node GetCloserElementFromGeometry.dyf (Dynamo 2.3.0.5885)
# category: PracticalBIM.Revit.Elements
# Gets the Closer Element to the Geometry

PoolofElements = Input(PoolofElements: Revit.Elements.Element[])
UsedGeometry = Input(UsedGeometry: Autodesk.DesignScript.Geometry.Geometry[])
PooltoSelect = Input(PooltoSelect: Autodesk.DesignScript.Geometry.Geometry[])
distanceTo = Geometry.DistanceTo(geometry=UsedGeometry, other=PooltoSelect, lacing=CrossProduct)
minimumItem = List.MinimumItem(list=distanceTo@L2)
indexOf = List.IndexOf(list=distanceTo@L2, element=minimumItem, lacing=Shortest)
getItemAtIndex = List.GetItemAtIndex(list=PoolofElements, index=indexOf)
SelectedElements = Output(getItemAtIndex)  # "SelectedElements:Element[]"
