# Dynamo custom node GetConnectorsatpoints.dyf (Dynamo 2.2.1.5175)
# category: PracticalBIM.Revit.Elements.MEP.Connectors
# Gets the Connector at a Point XY

pipeconnectors = Input(pipeconnectors: var[])
pipeConnectorpoint = Input(pipeConnectorpoint: Autodesk.DesignScript.Geometry.Point[])
X = Point.X(point=pipeConnectorpoint)
string_from_object = FromObject(obj=X)
Y = Point.Y(point=pipeConnectorpoint)
string_from_object_2 = FromObject(obj=Y)
Z = Point.Z(point=pipeConnectorpoint)
string_from_object_3 = FromObject(obj=Z)
code_block = CodeBlock(a=string_from_object, b=string_from_object_2, c=string_from_object_3) { a+"/"+b+"/"+c; }
fixturepoint = Input(fixturepoint: Autodesk.DesignScript.Geometry.Point[])
X_2 = Point.X(point=fixturepoint)
string_from_object_4 = FromObject(obj=X_2)
Y_2 = Point.Y(point=fixturepoint)
string_from_object_5 = FromObject(obj=Y_2)
Z_2 = Point.Z(point=fixturepoint)
string_from_object_6 = FromObject(obj=Z_2)
code_block_2 = CodeBlock(a=string_from_object_4, b=string_from_object_5, c=string_from_object_6) { a+"/"+b+"/"+c; }
indexOf = List.IndexOf(list=code_block, element=code_block_2)
getItemAtIndex = List.GetItemAtIndex(list=pipeconnectors, index=indexOf)
Connectors = Output(getItemAtIndex)  # "Connectors[]"
