# Dynamo custom node GetOffsetDistancefromSlopeofLineandLength.dyf (Dynamo 2.3.0.5885)
# category: PracticalBIM.Geometry.Curves
# Get Offset Distance from Slope of LIne

curve = Input(curve: Autodesk.DesignScript.Geometry.Curve[])
endPoint = Curve.EndPoint(curve=curve)
Z = Point.Z(point=endPoint)
startPoint = Curve.StartPoint(curve=curve)
Z_2 = Point.Z(point=startPoint)
code_block = CodeBlock(a=Z, b=Z_2) { a-b; }
length = Curve.Length(curve=curve)
code_block_2 = CodeBlock(a=code_block, b=length) { a/b; }
lengthofelement = Input(lengthofelement: double[])
code_block_3 = CodeBlock(a=code_block_2, b=lengthofelement) { a*b; }
abs = Math.Abs(number=code_block_3)
offsetdistance = Output(abs)  # "offsetdistance:double"
