# Dynamo custom node GetOrientationVectorFromPointsMid.dyf (Dynamo 2.6.1.8786)
# category: PracticalBIM.Geometry.Abstract.Vector
# Get the Orientation Vectors From Points using MidPoints.
# packages: PracticalBIM 2020.0.26

points = Input(points: Autodesk.DesignScript.Geometry.Point[])
removeLast = Custom[RemoveLast](list=points)  # package PracticalBIM; Remove Last element of a List
code_block = CodeBlock { -1; }
shiftIndices = List.ShiftIndices(list=points, amount=code_block)
removeLast_2 = Custom[RemoveLast](list=shiftIndices)
byStartPointEndPoint = Line.ByStartPointEndPoint(startPoint=removeLast, endPoint=removeLast_2)
code_block_2 = CodeBlock { 0.5; }
pointAtParameter = Curve.PointAtParameter(curve=byStartPointEndPoint, param=code_block_2)
removeLast_3 = Custom[RemoveLast](list=pointAtParameter)
code_block_3 = CodeBlock { -1; }
shiftIndices_2 = List.ShiftIndices(list=pointAtParameter, amount=code_block_3)
removeLast_4 = Custom[RemoveLast](list=shiftIndices_2)
byStartPointEndPoint_2 = Line.ByStartPointEndPoint(startPoint=removeLast_3, endPoint=removeLast_4)
direction = Line.Direction(line=byStartPointEndPoint_2)
ResultingVectors = Output(direction)  # "ResultingVectors:Vector[]"
