# Dynamo custom node GetReferencedElementsFromFamilyandCategory.dyf (Dynamo 2.6.1.8786)
# category: PracticalBIM.Revit.Elements.Family
# Get Referenced Elements From Family and Category
# packages: PracticalBIM 2020.0.40

SelectedCategory = Input(SelectedCategory: Revit.Elements.Category)
FamilyName = Input(FamilyName: string)
getFamilybyCategoryandName = Custom[GetFamilybyCategoryandName](SelectedCategory=SelectedCategory, FamilyName=FamilyName)  # package PracticalBIM; Gets a family by Category and Name
code_block = CodeBlock { "Reference"; }
getParameterValueByName = Element.GetParameterValueByName(element=getFamilybyCategoryandName, parameterName=code_block)
SElementId = Input(SElementId: int[])
allIndicesOf = List.AllIndicesOf(list=getParameterValueByName, item=SElementId)
getItemAtIndex = List.GetItemAtIndex(list=getFamilybyCategoryandName, index=allIndicesOf)
PElements = Output(getItemAtIndex)  # "PElements:Elements"
