# Dynamo custom node GetStartingPrecedencebyLevel.dyf (Dynamo 2.2.1.5175)
# category: PracticalBIM.4dSimulation
# Gets the starting dates of precedence by Level Selected

CategoryandLevel = Input(CategoryandLevel: string[])
code_block = CodeBlock { "_"; }
indexOf = String.IndexOf(str=CategoryandLevel, searchFor=code_block)
code_block_2 = CodeBlock(a=indexOf) { a+1; }
length = String.Length(str=CategoryandLevel)
code_block_3 = CodeBlock(a=length, b=indexOf) { a-b-1; }
substring = String.Substring(str=CategoryandLevel, startIndex=code_block_2, length=code_block_3)
groupByKey = List.GroupByKey(list=CategoryandLevel, keys=substring)
GroupsofLevel = Output(groupByKey.groups)  # "GroupsofLevel:string[]..[]"
code_block_4 = CodeBlock { 0; }
TotalDurationofTasks = Input(TotalDurationofTasks: double[])
groupByKey_2 = List.GroupByKey(list=TotalDurationofTasks, keys=substring)
sum = Math.Sum(values=groupByKey_2.groups)
addItemToFront = List.AddItemToFront(item=code_block_4, list=sum)
removeLast = Custom[RemoveLast](list=addItemToFront)  # Remove Last element of a List
code_block_5 = CodeBlock(a=removeLast) { a*0.4; }
count = List.Count(list=code_block_5)
code_block_6 = CodeBlock(a=count) { 0..a-1..1; }
code_block_7 = CodeBlock(b=code_block_6) { 0..b..1; }
getItemAtIndex = List.GetItemAtIndex(list=code_block_5, index=code_block_7)
sum_2 = Math.Sum(values=getItemAtIndex)
addItemToFront_2 = List.AddItemToFront(item=code_block_4, list=code_block_5)
removeLast_2 = Custom[RemoveLast](list=addItemToFront_2)
count_2 = List.Count(list=removeLast_2)
code_block_8 = CodeBlock(a=count_2) { 0..a-1..1; }
code_block_9 = CodeBlock(b=code_block_8) { 0..b..1; }
getItemAtIndex_2 = List.GetItemAtIndex(list=removeLast_2, index=code_block_9)
sum_3 = Math.Sum(values=getItemAtIndex_2)
code_block_10 = CodeBlock(a=sum_2, b=sum_3) { a+b; }
code_block_11 = CodeBlock { 0; }
FactorsofSF = Input(FactorsofSF: double[])
code_block_12 = CodeBlock { 0; }
code_block_13 = CodeBlock { "_"; }
indexOf_2 = String.IndexOf(str=groupByKey.groups, searchFor=code_block_13)
substring_2 = String.Substring(str=groupByKey.groups, startIndex=code_block_12, length=indexOf_2)
toNumber = String.ToNumber(str=substring_2)
code_block_14 = CodeBlock(a=toNumber) { a-1; }
getItemAtIndex_3 = List.GetItemAtIndex(list=FactorsofSF, index=code_block_14)
code_block_15 = CodeBlock(a=groupByKey_2.groups, b=getItemAtIndex_3) { a*b; }
removeLast_3 = Custom[RemoveLast](list=code_block_15@L2)
addItemToFront_3 = List.AddItemToFront(item=code_block_11, list=removeLast_3, lacing=Longest)
code_block_16 = CodeBlock(a=code_block_10, b=addItemToFront_3) { a+b; }
flatten = List.Flatten(list=code_block_16)
StartDays = Output(flatten)  # "StartDays:double[]"
