# Dynamo custom node GetTextNoteOriginCoordintates.dyf (Dynamo 2.3.0.5885)
# category: PracticalBIM.Revit.Elements.TextNotes
# Gets the Text Note Origin Coordinates

TextNoteElements = Input(TextNoteElements: var[])
python_script = Python(IN[0]=TextNoteElements)
# ---------- python_script.python (16 lines) ----------
# Importing the 'Common Language Runtime' library
import clr
# Adding specific references: The Revit API
clr.AddReference('RevitAPI')
from Autodesk.Revit.DB import *
clr.AddReference('RevitNodes')
import Revit
clr.ImportExtensions(Revit.GeometryConversion)
clr.ImportExtensions(Revit.Elements)
# Creating an empty list that we populate later
OUT = []
# Running a 'for loop' over everything inside our input list
# by Unwrapping them (Which is requried between Revit and Dynamo
# objects
for item in UnwrapElement(IN[0]):
    OUT.append(item.Coord.ToPoint())
# ----------------------------------------
OriginPoints = Output(python_script)  # "OriginPoints:Point"
