# Dynamo custom node GetTopConnectorsofPipes.dyf (Dynamo 2.2.1.5175)
# category: PracticalBIM.Revit.Elements.MEP.Connectors
# Gets the top connectors of Pipes

list = Input(list: var[])
point = Input(point: Autodesk.DesignScript.Geometry.Point[])
Z = Point.Z(point=point)
maximumItem = List.MaximumItem(list=Z)
allIndicesOf = List.AllIndicesOf(list=Z, item=maximumItem)
getItemAtIndex = List.GetItemAtIndex(list=list, index=allIndicesOf)
topconnectors = Output(getItemAtIndex)  # "topconnectors[]"
