# Dynamo custom node GetUniqueCurves.dyf (Dynamo 2.2.1.5175)
# category: PracticalBIM.Geometry.Curves
# Gets from a List of Curves non Repeated Lines

curves = Input(curves: Autodesk.DesignScript.Geometry.Curve[]..[])
flatten = List.Flatten(list=curves)
endPoint = Curve.EndPoint(curve=flatten)
startPoint = Curve.StartPoint(curve=flatten)
firstItem = List.FirstItem(list=startPoint)
distanceTo = Geometry.DistanceTo(geometry=endPoint, other=firstItem)
distanceTo_2 = Geometry.DistanceTo(geometry=startPoint, other=firstItem)
gt = distanceTo > distanceTo_2
reverse = Curve.Reverse(curve=flatten)
if_ = If(test=gt, true=flatten, false=reverse)
string_from_object = FromObject(obj=if_)
uniqueItems = List.UniqueItems(list=string_from_object)
firstIndexOf = List.FirstIndexOf(list=string_from_object, item=uniqueItems)
getItemAtIndex = List.GetItemAtIndex(list=flatten, index=firstIndexOf)
Curve = Output(getItemAtIndex)  # "Curve[]"
