# Dynamo custom node GetUniquePoints.dyf (Dynamo 2.6.1.8786)
# category: PracticalBIM.Geometry.Points
# Gets all Unique Points

AllPoints = Input(AllPoints: Autodesk.DesignScript.Geometry.Point[])
string_from_object = FromObject(obj=AllPoints)
uniqueItems = List.UniqueItems(list=string_from_object)
firstIndexOf = List.FirstIndexOf(list=string_from_object, item=uniqueItems)
getItemAtIndex = List.GetItemAtIndex(list=AllPoints, index=firstIndexOf)
UniquePoints = Output(getItemAtIndex)  # "UniquePoints:Point[]"
