# Dynamo custom node GetVerticalDistanceValuefromSchedules.dyf (Dynamo 2.2.1.5175)
# category: PracticalBIM.Revit.View.Schedules
# Gets the distance it needs to pull down the next schedule to fit on a sheet

code_block = CodeBlock { 0; }
list = Input(list: var[]..[])
uniqueItems = List.UniqueItems(list=list@L2)
count = List.Count(list=uniqueItems@L2)
removeLast = Custom[RemoveLast](list=count)
valueofseparation = Input(valueofseparation: double)
code_block_2 = CodeBlock(a=removeLast, b=valueofseparation) { -a*b; }
addItemToFront = List.AddItemToFront(item=code_block, list=code_block_2)
count_2 = List.Count(list=addItemToFront)
code_block_3 = CodeBlock(a=count_2) { 1..#a..1; }
code_block_4 = CodeBlock(a=code_block_3) { 0..#a..1; }
getItemAtIndex = List.GetItemAtIndex(list=addItemToFront, index=code_block_4)
sum = Math.Sum(values=getItemAtIndex)
distances = Output(sum)  # "distances[]"
