# Dynamo custom node GetVerticalLinesFromSurface.dyf (Dynamo 2.2.1.5175)
# category: PracticalBIM.Geometry.Surfaces
# Get all Vertical Lines From a Surface

point = Input(point: Autodesk.DesignScript.Geometry.Point[]..[])
X = Point.X(point=point)
code_block = CodeBlock { 2; }
round = Math.Round(number=X, digits=code_block)
Y = Point.Y(point=point)
code_block_2 = CodeBlock { 2; }
round_2 = Math.Round(number=Y, digits=code_block_2)
byCoordinates = Point.ByCoordinates(x=round, y=round_2)
string_from_object = FromObject(obj=byCoordinates)
uniqueItems = List.UniqueItems(list=string_from_object@L2)
firstIndexOf = List.FirstIndexOf(list=string_from_object, item=uniqueItems)
getItemAtIndex = List.GetItemAtIndex(list=byCoordinates@L2, index=firstIndexOf@L2)
X_2 = Point.X(point=getItemAtIndex)
Y_2 = Point.Y(point=getItemAtIndex)
Z = Point.Z(point=point)
minimumItem = List.MinimumItem(list=Z)
byCoordinates_2 = Point.ByCoordinates(x=X_2, y=Y_2, z=minimumItem)
maximumItem = List.MaximumItem(list=Z)
byCoordinates_3 = Point.ByCoordinates(x=X_2, y=Y_2, z=maximumItem)
byStartPointEndPoint = Line.ByStartPointEndPoint(startPoint=byCoordinates_2, endPoint=byCoordinates_3)
Line = Output(byStartPointEndPoint)  # "Line[]"
