# Dynamo custom node GetallLineObjects.dyf (Dynamo 2.2.1.5175)
# category: PracticalBIM.Geometry.Curves
# Get all Curves from a List of LInes

list = Input(list: var)
type = Object.Type(obj=list)
code_block = CodeBlock { "Autodesk.DesignScript.Geometry.Line"; }
eq = type == code_block
code_block_2 = CodeBlock { true; }
allIndicesOf = List.AllIndicesOf(list=eq, item=code_block_2)
getItemAtIndex = List.GetItemAtIndex(list=list, index=allIndicesOf)
item = Output(getItemAtIndex)
