# Dynamo custom node GridSplitandSortLinesfromCenterfromaLine.dyf (Dynamo 2.2.1.5175)
# category: PracticalBIM.Revit.Elements.MEP.RoutingGrids
# SplitandSortLinesfromaCenterLine

PerpendicularLines = Input(PerpendicularLines: Autodesk.DesignScript.Geometry.Curve[])
MainLine = Input(MainLine: Autodesk.DesignScript.Geometry.Curve[])
split = Geometry.Split(geometry=PerpendicularLines, other=MainLine, lacing=Longest)
flatten = List.Flatten(list=split)
endPoint = Curve.EndPoint(curve=flatten)
distanceTo = Geometry.DistanceTo(geometry=endPoint, other=MainLine, lacing=Longest)
startPoint = Curve.StartPoint(curve=flatten)
distanceTo_2 = Geometry.DistanceTo(geometry=startPoint, other=MainLine, lacing=Longest)
gt = distanceTo > distanceTo_2
byStartPointEndPoint = Line.ByStartPointEndPoint(startPoint=startPoint, endPoint=endPoint)
byStartPointEndPoint_2 = Line.ByStartPointEndPoint(startPoint=endPoint, endPoint=startPoint)
if_ = If(test=gt, true=byStartPointEndPoint, false=byStartPointEndPoint_2)
ResultingSortedLines = Output(if_)  # "ResultingSortedLines[]"
