# Dynamo custom node GroupSurfacesandJoinbyIntersectionwithFloors.dyf (Dynamo 2.6.1.8786)
# category: PracticalBIM.Geometry.Surfaces
# Group Surfaces and Join by Intersection with Floors

PoolofSurfaces = Input(PoolofSurfaces: Autodesk.DesignScript.Geometry.Surface[])
FloorSurfaces = Input(FloorSurfaces: Autodesk.DesignScript.Geometry.Surface[])
doesIntersect = Geometry.DoesIntersect(geometry=FloorSurfaces, other=PoolofSurfaces, lacing=CrossProduct)
code_block = CodeBlock { true; }
allIndicesOf = List.AllIndicesOf(list=doesIntersect@L2, item=code_block)
getItemAtIndex = List.GetItemAtIndex(list=PoolofSurfaces, index=allIndicesOf)
byUnion = Surface.ByUnion(surfaces=getItemAtIndex)
ResultingSurfaces = Output(byUnion)  # "ResultingSurfaces:Surface[]"
