# Dynamo custom node IntersectionPointsbyLinesAllGrids.dyf (Dynamo 2.6.1.8786)
# category: PracticalBIM.Geometry.Points
# Intersects all Points with Wall Lines to Create a Grid System og all intersections.

LineList = Input(LineList: var[])
startPoint = Curve.StartPoint(curve=LineList)
X = Point.X(point=startPoint)
endPoint = Curve.EndPoint(curve=LineList)
X_2 = Point.X(point=endPoint)
join = List.Join(list0=X, list1=X_2)
code_block = CodeBlock { 2; }
round = Math.Round(number=join, digits=code_block)
uniqueItems = List.UniqueItems(list=round)
sort = List.Sort(list=uniqueItems)
Y = Point.Y(point=startPoint)
Y_2 = Point.Y(point=endPoint)
join_2 = List.Join(list0=Y, list1=Y_2)
round_2 = Math.Round(number=join_2, digits=code_block)
uniqueItems_2 = List.UniqueItems(list=round_2)
sort_2 = List.Sort(list=uniqueItems_2)
minimumItem = List.MinimumItem(list=sort_2)
code_block_2 = CodeBlock(a=minimumItem) { a-3; }
Z = Point.Z(point=startPoint)
byCoordinates = Point.ByCoordinates(x=sort, y=code_block_2, z=Z)
maximumItem = List.MaximumItem(list=sort_2)
code_block_3 = CodeBlock(a=maximumItem) { a+3; }
byCoordinates_2 = Point.ByCoordinates(x=sort, y=code_block_3, z=Z)
byStartPointEndPoint = Line.ByStartPointEndPoint(startPoint=byCoordinates, endPoint=byCoordinates_2)
minimumItem_2 = List.MinimumItem(list=sort)
code_block_4 = CodeBlock(a=minimumItem_2) { a-3; }
byCoordinates_3 = Point.ByCoordinates(x=code_block_4, y=sort_2, z=Z)
maximumItem_2 = List.MaximumItem(list=sort)
code_block_5 = CodeBlock(a=maximumItem_2) { a+3; }
byCoordinates_4 = Point.ByCoordinates(x=code_block_5, y=sort_2, z=Z)
byStartPointEndPoint_2 = Line.ByStartPointEndPoint(startPoint=byCoordinates_3, endPoint=byCoordinates_4)
intersect = Geometry.Intersect(geometry=byStartPointEndPoint, other=byStartPointEndPoint_2, lacing=CrossProduct)
flatten = List.Flatten(list=intersect)
doesIntersect = Geometry.DoesIntersect(geometry=LineList, other=flatten, lacing=CrossProduct)
code_block_6 = CodeBlock { true; }
allIndicesOf = List.AllIndicesOf(list=doesIntersect@L2, item=code_block_6)
flatten_2 = List.Flatten(list=allIndicesOf)
uniqueItems_3 = List.UniqueItems(list=flatten_2)
getItemAtIndex = List.GetItemAtIndex(list=flatten, index=uniqueItems_3)
item = Output(getItemAtIndex)
