# Dynamo custom node LineProjectedbyStartPointEndPointUp.dyf (Dynamo 2.2.1.5175)
# category: PracticalBIM.Geometry.Curves
# Creates a line from the intersection of Start Point and End Point

curve = Input(curve: Autodesk.DesignScript.Geometry.Curve)
length = Curve.Length(curve=curve)
code_block = CodeBlock(A=length) { 0..A..#10; }
pointAtSegmentLength = Curve.PointAtSegmentLength(curve=curve, segmentLength=code_block)
X = Point.X(point=pointAtSegmentLength)
Y = Point.Y(point=pointAtSegmentLength)
startPoint = Curve.StartPoint(curve=curve)
baseGeometry = Input(baseGeometry: Autodesk.DesignScript.Geometry.Geometry)
code_block_2 = CodeBlock { 2; }
byCoordinates = Vector.ByCoordinates(z=code_block_2)
project = Point.Project(point=startPoint, baseGeometry=baseGeometry, projectionDirection=byCoordinates)
Z = Point.Z(point=project)
endPoint = Curve.EndPoint(curve=curve)
project_2 = Point.Project(point=endPoint, baseGeometry=baseGeometry, projectionDirection=byCoordinates)
Z_2 = Point.Z(point=project_2)
code_block_3 = CodeBlock(a=Z, b=Z_2) { a..b..#10; }
flatten = List.Flatten(list=code_block_3)
byCoordinates_2 = Point.ByCoordinates(x=X, y=Y, z=flatten)
byControlPoints = NurbsCurve.ByControlPoints(points=byCoordinates_2)
NurbsCurve = Output(byControlPoints)
