# Dynamo custom node LinesFromGridUVandEdge.dyf (Dynamo 2.2.1.5175)
# category: PracticalBIM.Geometry.Curves
# Creates a Grid of Lines with U and V Parameters oriented to an Edge

SurfacetoGrid = Input(SurfacetoGrid: Autodesk.DesignScript.Geometry.Surface)
EdgeLine = Input(EdgeLine: Autodesk.DesignScript.Geometry.Curve)
perimeterCurves = Surface.PerimeterCurves(surface=SurfacetoGrid)
startPoint = Curve.StartPoint(curve=perimeterCurves)
closestPointTo = Geometry.ClosestPointTo(geometry=EdgeLine, other=startPoint)
string_from_object = FromObject(obj=startPoint)
string_from_object_2 = FromObject(obj=closestPointTo)
ne = string_from_object != string_from_object_2
code_block = CodeBlock { true; }
allIndicesOf = List.AllIndicesOf(list=ne, item=code_block)
getItemAtIndex = List.GetItemAtIndex(list=closestPointTo, index=allIndicesOf)
getItemAtIndex_2 = List.GetItemAtIndex(list=startPoint, index=allIndicesOf)
byStartPointEndPoint = Line.ByStartPointEndPoint(startPoint=getItemAtIndex, endPoint=getItemAtIndex_2)
direction = Line.Direction(line=byStartPointEndPoint)
direction_2 = Line.Direction(line=EdgeLine)
angleWithVector = Vector.AngleWithVector(vector=direction, otherVector=direction_2)
code_block_2 = CodeBlock { 90; }
eq = angleWithVector == code_block_2
code_block_3 = CodeBlock { true; }
allIndicesOf_2 = List.AllIndicesOf(list=eq, item=code_block_3)
getItemAtIndex_3 = List.GetItemAtIndex(list=byStartPointEndPoint, index=allIndicesOf_2)
length = Curve.Length(curve=getItemAtIndex_3)
maximumItem = List.MaximumItem(list=length)
firstIndexOf = List.FirstIndexOf(list=length, item=maximumItem)
getItemAtIndex_4 = List.GetItemAtIndex(list=getItemAtIndex_3, index=firstIndexOf)
UValues = Input(UValues: int)
code_block_4 = CodeBlock(n=UValues) { 0..1..#n+1; }
planeAtParameter = Curve.PlaneAtParameter(curve=getItemAtIndex_4, param=code_block_4)
intersect = Geometry.Intersect(geometry=SurfacetoGrid, other=planeAtParameter)
getallLineObjects = Custom[GetallLineObjects](list=intersect)  # Get all Curves from a List of LInes
flatten = List.Flatten(list=getallLineObjects)
ULines = Output(flatten)  # "ULines[]..[]"
length_2 = Curve.Length(curve=flatten)
maximumItem_2 = List.MaximumItem(list=length_2)
firstIndexOf_2 = List.FirstIndexOf(list=length_2, item=maximumItem_2)
getItemAtIndex_5 = List.GetItemAtIndex(list=flatten, index=firstIndexOf_2)
VValues = Input(VValues: int)
code_block_5 = CodeBlock(n=VValues) { 0..1..#n; }
planeAtParameter_2 = Curve.PlaneAtParameter(curve=getItemAtIndex_5, param=code_block_5)
intersect_2 = Geometry.Intersect(geometry=SurfacetoGrid, other=planeAtParameter_2)
flatten_2 = List.Flatten(list=intersect_2)
getallLineObjects_2 = Custom[GetallLineObjects](list=flatten_2)
flatten_3 = List.Flatten(list=getallLineObjects_2)
VLines = Output(flatten_3)  # "VLines[]..[]"
