# Dynamo custom node ListOrSingle.dyf (Dynamo 2.6.1.8786)
# category: PracticalBIM.Lists
# Sets if a result is a list or single

Items = Input(Items: var[]..[])
seq = Input(seq: var[]..[])
python_script = Python(IN[0]=Items, IN[1]=seq)
# ---------- python_script.python (4 lines) ----------
check = IN[0]
items = IN[1]
if isinstance(check, (list)): OUT = items
else: OUT = items[0]
# ----------------------------------------
result = Output(python_script)
