# Dynamo custom node LongDistanceRebarLineswithTopandSmallsides.dyf (Dynamo 2.2.1.5175)
# category: PracticalBIM.Rebar.Geometry
# Create a number of long distance Rebar using top and small sides and a number of lines

topsurface = Input(topsurface: Autodesk.DesignScript.Geometry.Surface)
code_block = CodeBlock { 0.5; }
normalAtParameter = Surface.NormalAtParameter(surface=topsurface, u=code_block, v=code_block)
reverse = Vector.Reverse(vector=normalAtParameter)
topoffsetdistance = Input(topoffsetdistance: double)
translate = Geometry.Translate(geometry=topsurface, direction=reverse, distance=topoffsetdistance)
smallsurface = Input(smallsurface: Autodesk.DesignScript.Geometry.Surface[])
intersect = Geometry.Intersect(geometry=translate, other=smallsurface, lacing=Longest)
flatten = List.Flatten(list=intersect)
code_block_2 = CodeBlock { 1; }
getItemAtIndex = List.GetItemAtIndex(list=flatten, index=code_block_2)
reverse_2 = Curve.Reverse(curve=getItemAtIndex)
replaceItemAtIndex = List.ReplaceItemAtIndex(list=flatten, index=code_block_2, item=reverse_2)
otheroffsetdistance = Input(otheroffsetdistance: double)
length = Curve.Length(curve=replaceItemAtIndex)
code_block_3 = CodeBlock(a=otheroffsetdistance, b=length) { a..b-a..#2; }
pointAtSegmentLength = Curve.PointAtSegmentLength(curve=replaceItemAtIndex, segmentLength=code_block_3)
byBestFitThroughPoints = Line.ByBestFitThroughPoints(bestFitPoints=pointAtSegmentLength)
normalAtParameter_2 = Surface.NormalAtParameter(surface=smallsurface, u=code_block, v=code_block)
reverse_3 = Vector.Reverse(vector=normalAtParameter_2)
translate_2 = Geometry.Translate(geometry=byBestFitThroughPoints, direction=reverse_3, distance=otheroffsetdistance)
numberofelements = Input(numberofelements: double)
code_block_4 = CodeBlock { 1; }
eq = numberofelements == code_block_4
code_block_5 = CodeBlock { 0.5; }
code_block_6 = CodeBlock(a=numberofelements) { 0..1..#a; }
if_ = If(test=eq, true=code_block_5, false=code_block_6)
pointAtParameter = Curve.PointAtParameter(curve=translate_2, param=if_, lacing=CrossProduct)
transpose = List.Transpose(lists=pointAtParameter)
byBestFitThroughPoints_2 = Line.ByBestFitThroughPoints(bestFitPoints=transpose)
toplonglines = Output(byBestFitThroughPoints_2)  # "toplonglines:Curve[]"
