# Dynamo custom node LongDistanceRebarforColumns2SidesTopBottomandSides.dyf (Dynamo 2.2.1.5175)
# category: PracticalBIM.Rebar.Geometry
# Creates Long Distance Rebar Lines for Columns with different sides

bottomsurface = Input(bottomsurface: Autodesk.DesignScript.Geometry.Surface)
code_block = CodeBlock { 0.5; }
normalAtParameter = Surface.NormalAtParameter(surface=bottomsurface, u=code_block, v=code_block)
reverse = Vector.Reverse(vector=normalAtParameter)
Bottomdistance = Input(Bottomdistance: double)
translate = Geometry.Translate(geometry=bottomsurface, direction=reverse, distance=Bottomdistance)
smallsidesurface = Input(smallsidesurface: Autodesk.DesignScript.Geometry.Surface[])
code_block_2 = CodeBlock { 0.5; }
normalAtParameter_2 = Surface.NormalAtParameter(surface=smallsidesurface, u=code_block_2, v=code_block_2)
reverse_2 = Vector.Reverse(vector=normalAtParameter_2)
Otherfacesdistance = Input(Otherfacesdistance: double)
translate_2 = Geometry.Translate(geometry=smallsidesurface, direction=reverse_2, distance=Otherfacesdistance, lacing=Longest)
intersect = Geometry.Intersect(geometry=translate, other=translate_2, lacing=Longest)
flatten = List.Flatten(list=intersect)
longsidesurface = Input(longsidesurface: Autodesk.DesignScript.Geometry.Surface[])
code_block_3 = CodeBlock { 0.5; }
normalAtParameter_3 = Surface.NormalAtParameter(surface=longsidesurface, u=code_block_3, v=code_block_3)
reverse_3 = Vector.Reverse(vector=normalAtParameter_3)
translate_3 = Geometry.Translate(geometry=longsidesurface, direction=reverse_3, distance=Otherfacesdistance, lacing=Longest)
intersect_2 = Geometry.Intersect(geometry=translate, other=translate_3, lacing=Longest)
flatten_2 = List.Flatten(list=intersect_2)
intersect_3 = Geometry.Intersect(geometry=flatten, other=flatten_2, lacing=CrossProduct)
flatten_3 = List.Flatten(list=intersect_3)
code_block_4 = CodeBlock { [0,1,3,2]; }
getItemAtIndex = List.GetItemAtIndex(list=flatten_3, index=code_block_4)
byPerimeterPoints = Surface.ByPerimeterPoints(points=getItemAtIndex)
perimeterCurves = Surface.PerimeterCurves(surface=byPerimeterPoints)
code_block_5 = CodeBlock { [1,3]; }
long_lines = List.GetItemAtIndex(list=perimeterCurves, index=code_block_5)
longlinenumber = Input(longlinenumber: double)
code_block_6 = CodeBlock(a=longlinenumber) { 0..1..#a; }
pointAtParameter = Curve.PointAtParameter(curve=long_lines, param=code_block_6, lacing=CrossProduct)
flatten_4 = List.Flatten(list=pointAtParameter)
code_block_7 = CodeBlock { 0.5; }
pointAtParameter_2 = Surface.PointAtParameter(surface=translate, u=code_block_7, v=code_block_7)
topsurface = Input(topsurface: Autodesk.DesignScript.Geometry.Surface)
normalAtParameter_4 = Surface.NormalAtParameter(surface=topsurface, u=code_block, v=code_block)
reverse_4 = Vector.Reverse(vector=normalAtParameter_4)
Topdistance = Input(Topdistance: double)
translate_4 = Geometry.Translate(geometry=topsurface, direction=reverse_4, distance=Topdistance)
pointAtParameter_3 = Surface.PointAtParameter(surface=translate_4, u=code_block_7, v=code_block_7)
byTwoPoints = Vector.ByTwoPoints(start=pointAtParameter_2, end=pointAtParameter_3)
translate_5 = Geometry.Translate(geometry=flatten_4, direction=byTwoPoints, lacing=CrossProduct)
flatten_5 = List.Flatten(list=translate_5)
byStartPointEndPoint = Line.ByStartPointEndPoint(startPoint=flatten_4, endPoint=flatten_5)
code_block_8 = CodeBlock { [0,2]; }
short_lines = List.GetItemAtIndex(list=perimeterCurves, index=code_block_8)
shortlinenumber = Input(shortlinenumber: double)
code_block_9 = CodeBlock(a=shortlinenumber) { 0..1..#a; }
code_block_10 = CodeBlock { 1; }
removeNItemsBeginEnd = Custom[RemoveNItemsBeginEnd](list=code_block_9, numbertoremove=code_block_10)  # Removes a Number of Items from the Begining and from End
pointAtParameter_4 = Curve.PointAtParameter(curve=short_lines, param=removeNItemsBeginEnd, lacing=CrossProduct)
flatten_6 = List.Flatten(list=pointAtParameter_4)
translate_6 = Geometry.Translate(geometry=flatten_6, direction=byTwoPoints, lacing=CrossProduct)
flatten_7 = List.Flatten(list=translate_6)
byStartPointEndPoint_2 = Line.ByStartPointEndPoint(startPoint=flatten_6, endPoint=flatten_7)
join = List.Join(list0=byStartPointEndPoint, list1=byStartPointEndPoint_2)
verticalLines = Output(join)  # "verticalLines:Line[]"
