# Dynamo custom node MeshIntersectswithaPlane.dyf (Dynamo 2.6.1.8786)
# category: PracticalBIM.Revit.Elements.Topography
# Get Intersections of a Mesh with Planes

mesh = Input(mesh: Autodesk.DesignScript.Geometry.Mesh)
faceMeshVertices = Custom[FaceMeshVertices](mesh=mesh)  # Creates a Face Mesh Vertices Creation
closedLoopThroughPointsonCurve = Custom[ClosedLoopThroughPointsonCurve](points=faceMeshVertices@L2)  # Gets a Loop of Points using a Curve
plane = Input(plane: Autodesk.DesignScript.Geometry.Plane)
# note: From Mesh to Curves
intersect = Geometry.Intersect(geometry=closedLoopThroughPointsonCurve, other=plane)
flatten = List.Flatten(list=intersect)
origin = Point.Origin()
normal = Plane.Normal(plane=plane)
YAxis = Vector.YAxis()
ZAxis = Vector.ZAxis()
XAxis = Vector.XAxis()
code_block = CodeBlock(vec=normal, yaxis=YAxis, zaxis=ZAxis, xaxis=XAxis)
# ---------- code_block.designscript (4 lines) ----------
cond1 = Math.Abs(vec.Y) > Math.Abs(vec.X) && Math.Abs(vec.Y) > Math.Abs(vec.Z);
cond2 = Math.Abs(vec.X) > Math.Abs(vec.Y) && Math.Abs(vec.X) > Math.Abs(vec.Z);
cond3 = cond1 ? yaxis : zaxis;
cond2 ? xaxis : cond3;
# ----------------------------------------
asPoint = Vector.AsPoint(vector=code_block.out3)
flatten_2 = List.Flatten(list=faceMeshVertices)
byBestFitThroughPoints = Plane.ByBestFitThroughPoints(points=flatten_2)
normal_2 = Plane.Normal(plane=byBestFitThroughPoints)
YAxis_2 = Vector.YAxis()
ZAxis_2 = Vector.ZAxis()
XAxis_2 = Vector.XAxis()
code_block_2 = CodeBlock(vec=normal_2, yaxis=YAxis_2, zaxis=ZAxis_2, xaxis=XAxis_2)  # same code as code_block
asPoint_2 = Vector.AsPoint(vector=code_block_2.out3)
create = List.Create(item0=origin, item1=asPoint, item2=asPoint_2)
# note: Make a plane based on the given axes and the origin
byBestFitThroughPoints_2 = Plane.ByBestFitThroughPoints(points=create)
# note: The normal of that plane is the vector of the third axis
normal_3 = Plane.Normal(plane=byBestFitThroughPoints_2)
code_block_3 = CodeBlock(vec=normal_3)
# ---------- code_block_3.designscript (4 lines) ----------
// Set up a nested condition and find the main direction of the vector
cond1 = Math.Abs(vec.Y) > Math.Abs(vec.X) && Math.Abs(vec.Y) > Math.Abs(vec.Z);
cond2 = Math.Abs(vec.X) > Math.Abs(vec.Y) && Math.Abs(vec.X) > Math.Abs(vec.Z);
cond2 ? "X" : (cond1 ? "Y" : "Z");
# ----------------------------------------
Y = Point.Y(lacing=Longest)  # unwired: point
Z = Point.Z(lacing=Longest)  # unwired: point
X = Point.X(lacing=Longest)  # unwired: point
code_block_4 = CodeBlock(ax=code_block_3.out2, ysort=Y, zsort=Z, xsort=X)
# ---------- code_block_4.designscript (6 lines) ----------
// Establish sorting direction
// based on general plane and mesh orientation
cond1 = ax == "Y";
res = cond1 ? ysort : zsort;
cond2 = ax == "X";
cond2 ? xsort : res;
# ----------------------------------------
sortByFunction = List.SortByFunction(list=flatten, func=code_block_4.out3)
formula = Formula("1.0e-9")
pruneDuplicates = Point.PruneDuplicates(points=sortByFunction, tolerance=formula)
points = Output(pruneDuplicates)
byPoints = PolyCurve.ByPoints(points=pruneDuplicates)
polyCurve = Output(byPoints)
byPoints_2 = NurbsCurve.ByPoints(points=pruneDuplicates)
nurbsCurveByPoints = Output(byPoints_2)
byControlPoints = NurbsCurve.ByControlPoints(points=pruneDuplicates)
nurbsCurveByControlPoints = Output(byControlPoints)
