# Dynamo custom node PointsbySinsecuenceonZ.dyf (Dynamo 2.2.1.5175)
# category: PracticalBIM.Geometry.Points.RoallerCoaster
# Creates a secuence of points by sin function on Z

curve = Input(curve: Autodesk.DesignScript.Geometry.Curve)
numberofpoints = Input(numberofpoints: double)
code_block = CodeBlock(n=numberofpoints) { 0..1..#n; }
pointAtParameter = Curve.PointAtParameter(curve=curve, param=code_block)
endangle = Input(endangle: double)
code_block_2 = CodeBlock(ang=endangle, n=numberofpoints) { 0..ang..#n; }
sin = Math.Sin(angle=code_block_2)
min = Input(min: double)
max = Input(max: double)
remapRange = Math.RemapRange(numbers=sin, newMin=min, newMax=max)
byCoordinates = Vector.ByCoordinates(z=remapRange)
translate = Geometry.Translate(geometry=pointAtParameter, direction=byCoordinates)
finalpoints = Output(translate)  # "finalpoints:Points[]"
