# Dynamo custom node PointsfromCurvebyNSegmenthLength.dyf (Dynamo 2.2.1.5175)
# category: PracticalBIM.Geometry.Curves
# Create Points from a Curve using a given segment length

curve = Input(curve: Autodesk.DesignScript.Geometry.Curve[])
length = Curve.Length(curve=curve)
b = Input(b: var[]..[])
code_block = CodeBlock(a=length, b=b) { 0..a..b; }
addItemToEnd = List.AddItemToEnd(item=length, list=code_block, lacing=Shortest)
pointAtSegmentLength = Curve.PointAtSegmentLength(curve=curve, segmentLength=addItemToEnd)
Point = Output(pointAtSegmentLength)  # "Point[]"
