# Dynamo custom node ProjectedLocationfromCropView.dyf (Dynamo 2.2.1.5175)
# category: PracticalBIM.GN
# Creates a Projected location on a CropView

CropBoxCurves = Input(CropBoxCurves: Autodesk.DesignScript.Geometry.Line[])
byJoinedCurves = PolyCurve.ByJoinedCurves(curves=CropBoxCurves)
byPatch = Surface.ByPatch(closedCurve=byJoinedCurves)
GeometrytoProject = Input(GeometrytoProject: Autodesk.DesignScript.Geometry.Geometry[])
code_block = CodeBlock { 0.5; }
normalAtParameter = Surface.NormalAtParameter(surface=byPatch, u=code_block, v=code_block)
reverse = Vector.Reverse(vector=normalAtParameter)
projectInputOnto = Surface.ProjectInputOnto(surface=byPatch, geometryToProject=GeometrytoProject, projectionDirection=reverse)
ProjectedGeometry = Output(projectInputOnto)
