# Dynamo custom node ProjectedLocationofCentroidonaCropBox.dyf (Dynamo 2.2.1.5175)
# category: PracticalBIM.Revit.View
# Useitto project a centroid to a cropbox

curves = Input(curves: Autodesk.DesignScript.Geometry.Curve[]..[])
byJoinedCurves = PolyCurve.ByJoinedCurves(curves=curves)
byPatch = Surface.ByPatch(closedCurve=byJoinedCurves)
code_block = CodeBlock { 0.5; }
pointAtParameter = Surface.PointAtParameter(surface=byPatch, u=code_block, v=code_block)
geometryToProject = Input(geometryToProject: Autodesk.DesignScript.Geometry.Geometry[])
normalAtParameter = Surface.NormalAtParameter(surface=byPatch, u=code_block, v=code_block)
reverse = Vector.Reverse(vector=normalAtParameter)
projectInputOnto = Surface.ProjectInputOnto(surface=byPatch, geometryToProject=geometryToProject, projectionDirection=reverse)
flatten = List.Flatten(list=projectInputOnto)
byTwoPoints = Vector.ByTwoPoints(start=pointAtParameter, end=flatten)
Vector = Output(byTwoPoints)  # "Vector[]"
