# Dynamo custom node RandomLaticebyPerimeterLinesandCenterLines.dyf (Dynamo 2.2.1.5175)
# category: PracticalBIM.Geometry.Abstract.Topology
# Creates a random List of lines related to perimeter an center lines

Perimetercurve = Input(Perimetercurve: Autodesk.DesignScript.Geometry.Curve[])
code_block = CodeBlock { 0.5; }
pointAtParameter = Curve.PointAtParameter(curve=Perimetercurve, param=code_block)
code_block_2 = CodeBlock { 2; }
cycle = List.Cycle(list=pointAtParameter, amount=code_block_2)
Centercurve = Input(Centercurve: Autodesk.DesignScript.Geometry.Curve[])
pointAtParameter_2 = Curve.PointAtParameter(curve=Centercurve, param=code_block)
code_block_3 = CodeBlock { 4; }
cycle_2 = List.Cycle(list=pointAtParameter_2, amount=code_block_3)
shuffle = List.Shuffle(list=cycle_2)
flatten = List.Flatten(list=shuffle)
byStartPointEndPoint = Line.ByStartPointEndPoint(startPoint=cycle, endPoint=flatten, lacing=Shortest)
code_block_4 = CodeBlock { [0,1]; }
planeAtParameter = Curve.PlaneAtParameter(curve=byStartPointEndPoint, param=code_block_4, lacing=CrossProduct)
radius = Input(radius: double)
byPlaneRadius = Circle.ByPlaneRadius(plane=planeAtParameter, radius=radius)
byLoft = Solid.ByLoft(crossSections=byPlaneRadius)
Solid = Output(byLoft)
