# Dynamo custom node RebarBarTypefromName.dyf (Dynamo 2.2.1.5175)
# category: PracticalBIM.Rebar
# Gets the Rebar Bar Types from a List with names

element_types = ElementTypes("RebarBarType")
all_elements_of_type = ElementsOfType(element_type=element_types)
name = Element.Name(element=all_elements_of_type)
listofrebarbartypes = Input(listofrebarbartypes: string[])
allIndicesOf = List.AllIndicesOf(list=name, item=listofrebarbartypes)
getItemAtIndex = List.GetItemAtIndex(list=all_elements_of_type, index=allIndicesOf)
flatten = List.Flatten(list=getItemAtIndex)
rebarbartypeelements = Output(flatten)  # "rebarbartypeelements:var[]"
