# Dynamo custom node RemoveCategoriesfromSelection.dyf (Dynamo 2.2.1.5175)
# category: PracticalBIM.Revit.Elements.Element
# Removes Categories from a Selection by a String List

elements = Input(elements: Revit.Elements.Element[])
getCategory = Element.GetCategory(element=elements)
name = Category.Name(category=getCategory)
item = Input(item: string)
allIndicesOf = List.AllIndicesOf(list=name, item=item)
removeItemAtIndex = List.RemoveItemAtIndex(list=elements, indices=allIndicesOf)
elements_2 = Output(name)  # "elements[]"
