# Dynamo custom node RemoveFamilyTypesfromaList.dyf (Dynamo 2.2.1.5175)
# category: PracticalBIM.Revit.Elements
# Remove Family Types from a given list

list = Input(list: var[])
FamilyObjectType = Input(FamilyObjectType: string)
type = Object.Type(obj=list)
eq = FamilyObjectType == type
code_block = CodeBlock { true; }
allIndicesOf = List.AllIndicesOf(list=eq, item=code_block)
removeItemAtIndex = List.RemoveItemAtIndex(list=list, indices=allIndicesOf)
list_2 = Output(removeItemAtIndex)  # "list:var[]"
