# Dynamo custom node ReorderStringsbyReorderOfElementsNumberofElements.dyf (Dynamo 2.3.0.5885)
# category: PracticalBIM.String
# Reorder Strings From a List by the Number of Elements
# packages: PracticalBIM 2020.0.41

code_block = CodeBlock { "_"; }
strings = Input(strings: string)
split = String.Split(str=strings, separator0=code_block)
code_block_2 = CodeBlock { 1; }
flatten = List.Flatten(list=split, amt=code_block_2)
count = List.Count(list=flatten@L2)
reorderElementsLiLbyNumberofElements = Custom[ReorderElementsLiLbyNumberofElements](count=count)  # package PracticalBIM; Gets a Reorder of Elements using the Distances from them
code_block_3 = CodeBlock { 1; }
flatten_2 = List.Flatten(list=reorderElementsLiLbyNumberofElements, amt=code_block_3)
getItemAtIndex = List.GetItemAtIndex(list=flatten@L2, index=flatten_2@L2)
join = String.Join(separator=code_block, string0=getItemAtIndex)
reorderedStrings = Output(join)  # "reorderedStrings:string[]"
