# Dynamo custom node ReplaceItemsAtIndexes.dyf "ReplaceItemsatIndexes" (Dynamo 2.5.0.7460)
# category: PracticalBIM.Lists
# Replace a list of Items at Indexes

list1 = Input(list1: var[]..[])
item = Input(item: var[]..[])
toList = Custom[ToList](unknownItem=item)  # GetsElementToList
indices = Input(indices: int[]..[])
toList_2 = Custom[ToList](unknownItem=indices)
python_script = Python(IN[0]=list1, IN[1]=toList, IN[2]=toList_2)
# ---------- python_script.python (9 lines) ----------
_list = IN[0]
rValues = IN[1]
iValues = IN[2]
if len(iValues) > 1 and len(rValues) == 1:
	rValues = [rValues[0]] * len(iValues)
if len(iValues) > 0:
	for (index, value) in zip(iValues, rValues):
		_list[index] = value
OUT = _list
# ----------------------------------------
ReplacedList = Output(python_script)  # "ReplacedList:List[]"
