# Dynamo custom node ResetElementonViewOverrides.dyf (Dynamo 2.6.1.8786)
# category: PracticalBIM.Revit.Elements
# Reset the Elements Overrides on View
# packages: PracticalBIM 2020.0.35

element = Input(element: var[]..[])
toList = Custom[ToList](variousItems=element)  # package PracticalBIM; Turns a set of elements into one List
view = Input(view: var[]..[])
python_script = Python(IN[0]=toList, IN[1]=view)
# ---------- python_script.python (28 lines) ----------
import clr
clr.AddReference('RevitAPI')
from Autodesk.Revit.DB import *

clr.AddReference("RevitNodes")
import Revit
clr.ImportExtensions(Revit.Elements)

clr.AddReference("RevitServices")
import RevitServices
from RevitServices.Persistence import DocumentManager
from RevitServices.Transactions import TransactionManager

doc = DocumentManager.Instance.CurrentDBDocument
items = UnwrapElement(IN[0])
view = UnwrapElement(IN[1])
booleans = []

override = OverrideGraphicSettings()

TransactionManager.Instance.EnsureInTransaction(doc)
for item in items:
	try:
		view.SetElementOverrides(item.Id, override)
		booleans.append(True)
	except: booleans.append(False)
TransactionManager.Instance.TransactionTaskDone()
OUT = (items,view,booleans)
# ----------------------------------------
code_block = CodeBlock(seq=python_script) { seq[0]; seq[1]; seq[2]; }
view_2 = Output(code_block.out1)  # "view"
listOrSingle = Custom[ListOrSingle](Items=element, seq=code_block.out0)  # package PracticalBIM; Sets if a result is a list or single
element_2 = Output(listOrSingle)  # "element"
listOrSingle_2 = Custom[ListOrSingle](Items=element, seq=code_block.out2)
success = Output(listOrSingle_2)
