# Dynamo custom node SanitaryConnectionBackWithSlopes.dyf (Dynamo 2.2.1.5175)
# category: PracticalBIM.Revit.Elements.MEP.Sanitary
# Creates a Sanitary Connection going back using conectors and a Main line

conectorpoint = Input(conectorpoint: Autodesk.DesignScript.Geometry.Point[])
Conectordirection = Input(Conectordirection: Autodesk.DesignScript.Geometry.Vector[])
radiusfromconnector = Input(radiusfromconnector: double[])
code_block = CodeBlock(a=radiusfromconnector) { a*0.3048*2; }
code_block_2 = CodeBlock(a=code_block) { a*2; }
translate = Geometry.Translate(geometry=conectorpoint, direction=Conectordirection, distance=code_block_2)
line4 = Line.ByStartPointEndPoint(startPoint=translate, endPoint=conectorpoint)
Line4 = Output(line4)  # "Line4:Line[]"
code_block_3 = CodeBlock { -1; }
byCoordinates = Vector.ByCoordinates(z=code_block_3)
Z = Point.Z(point=translate)
pipeline = Input(pipeline: Autodesk.DesignScript.Geometry.Line)
startPoint = Curve.StartPoint(curve=pipeline)
Z_2 = Point.Z(point=startPoint)
code_block_4 = CodeBlock(a=Z, b=Z_2) { a-b+2; }
translate_2 = Geometry.Translate(geometry=translate, direction=byCoordinates, distance=code_block_4)
byStartPointEndPoint = Line.ByStartPointEndPoint(startPoint=translate, endPoint=translate_2)
vectorofalinegoingdown = Custom[Vectorofalinegoingdown](curve=pipeline)  # Gets the vector of a line going down
closestPointTo = Geometry.ClosestPointTo(geometry=pipeline, other=translate_2)
coordinateSystembyPointandVectorOveraCur = Custom[CoordinateSystembyPointandVectorOveraCurveforLinearFamilies](vector=vectorofalinegoingdown, origin=closestPointTo, lacing=Longest)  # Creates a Coordinate System on Everypoint with Vectors over a Curve
code_block_5 = CodeBlock(a=code_block_2) { a*2; }
byCartesianCoordinates = Point.ByCartesianCoordinates(cs=coordinateSystembyPointandVectorOveraCur, z=code_block_5)
Z_3 = Point.Z(point=byCartesianCoordinates)
code_block_6 = CodeBlock(a=code_block_5) { -a; }
byCartesianCoordinates_2 = Point.ByCartesianCoordinates(cs=coordinateSystembyPointandVectorOveraCur, z=code_block_6)
Z_4 = Point.Z(point=byCartesianCoordinates_2)
gt = Z_3 > Z_4
if_ = If(test=gt, true=byCartesianCoordinates_2, false=byCartesianCoordinates)
byCartesianCoordinates_3 = Point.ByCartesianCoordinates(cs=coordinateSystembyPointandVectorOveraCur, x=code_block_6)
distanceTo = Geometry.DistanceTo(geometry=conectorpoint, other=byCartesianCoordinates_3)
byCartesianCoordinates_4 = Point.ByCartesianCoordinates(cs=coordinateSystembyPointandVectorOveraCur, x=code_block_5)
distanceTo_2 = Geometry.DistanceTo(geometry=conectorpoint, other=byCartesianCoordinates_4)
gt_2 = distanceTo > distanceTo_2
if_2 = If(test=gt_2, true=byCartesianCoordinates_4, false=byCartesianCoordinates_3)
line1 = Line.ByStartPointEndPoint(startPoint=if_, endPoint=if_2)
byLineAndPoint = Plane.ByLineAndPoint(line=line1, point=closestPointTo)
intersect = Geometry.Intersect(geometry=byStartPointEndPoint, other=byLineAndPoint)
flatten = List.Flatten(list=intersect)
line3 = Line.ByStartPointEndPoint(startPoint=flatten, endPoint=translate)
Line3 = Output(line3)  # "Line3:Line[]"
line2 = Line.ByStartPointEndPoint(startPoint=if_2, endPoint=flatten)
flatten_2 = List.Flatten(list=line2)
Line2 = Output(flatten_2)  # "Line2:Line[]"
flatten_3 = List.Flatten(list=line1)
Line1 = Output(flatten_3)  # "Line1: Line[]"
Z_5 = Point.Z()  # unwired: point
