# Dynamo custom node ScheduleFormatingforTotals.dyf (Dynamo 2.2.1.5175)
# category: PracticalBIM.Revit.View.Schedules
# Sets Formatting for Schedules that would have total values

schedule = Input(schedule: Revit.Elements.Views.ScheduleView[])
ParameterField = Input(ParameterField: string)
list_create = List.Create(item0=ParameterField)
ParameterHeader = Input(ParameterHeader: string)
list_create_2 = List.Create(item0=ParameterHeader)
code_block = CodeBlock { [false]; }
list_create_3 = List.Create(item0=code_block)
code_block_2 = CodeBlock { ["Horizontal"]; }
list_create_4 = List.Create(item0=code_block_2)
code_block_3 = CodeBlock { ["Left"]; }
list_create_5 = List.Create(item0=code_block_3)
ColumnWidth = Input(ColumnWidth: double)
list_create_6 = List.Create(item0=ColumnWidth)
code_block_4 = CodeBlock { [true]; }
list_create_7 = List.Create(item0=code_block_4)
scheduleFormatting = Custom[ScheduleFormatting](schedule=schedule, parametername=list_create@L2, columnheading=list_create_2@L2, hidden=list_create_3@L2, headingorientation=list_create_4@L2, horizontalalign=list_create_5@L2, columnwidth=list_create_6@L2, totals=list_create_7@L2, lacing=Longest)  # Set a Schedule Formatting Setting
OUT = Output(scheduleFormatting)
