# Dynamo custom node SeparateGridLocationValueFromXMLNavisworks.dyf (Dynamo 2.2.1.5175)
# category: PracticalBIM.ClashDetection
# Separates the values of Grids and Levels from a Native export of Navisworks XML

gridlocation = Input(gridlocation: string)
code_block = CodeBlock { 0; }
code_block_2 = CodeBlock { "-"; }
indexOf = String.IndexOf(str=gridlocation, searchFor=code_block_2)
grid_a = String.Substring(str=gridlocation, startIndex=code_block, length=indexOf)
gridA = Output(grid_a)  # "gridA:string"
code_block_3 = CodeBlock(A=indexOf) { A+1; }
code_block_4 = CodeBlock { ":"; }
indexOf_2 = String.IndexOf(str=gridlocation, searchFor=code_block_4)
code_block_5 = CodeBlock(A=indexOf_2, B=indexOf) { A-B-2; }
grid_b = String.Substring(str=gridlocation, startIndex=code_block_3, length=code_block_5)
gridB = Output(grid_b)  # "gridB:string"
code_block_6 = CodeBlock(A=indexOf_2) { A+2; }
length = String.Length(str=gridlocation)
code_block_7 = CodeBlock(A=length, B=code_block_6) { A-B; }
level = String.Substring(str=gridlocation, startIndex=code_block_6, length=code_block_7)
level_2 = Output(level)  # "level:string"
