# Dynamo custom node SeparateLinesbyPlanesofIntersection.dyf (Dynamo 2.3.0.5885)
# category: PracticalBIM.Geometry.Curves
# Separates Lines by Planes of Intersection

curvestoseparate = Input(curvestoseparate: Autodesk.DesignScript.Geometry.Geometry)
planesforDivision = Input(planesforDivision: Autodesk.DesignScript.Geometry.Geometry[])
intersect = Geometry.Intersect(geometry=curvestoseparate, other=planesforDivision)
flatten = List.Flatten(list=intersect)
splitByPoints = Curve.SplitByPoints(curve=curvestoseparate, points=flatten)
Curve = Output(splitByPoints)
