# Dynamo custom node SettingParameterSimulation.dyf (Dynamo 2.2.1.5175)
# category: PracticalBIM.4dSimulation
# Sets the Value for Simulation with the Location values and the Category Priority

ElementsList = Input(ElementsList: Revit.Elements.Element[])
code_block = CodeBlock { "SIMULATION"; }
CategoryPriority = Input(CategoryPriority: string[])
code_block_2 = CodeBlock { "_"; }
LocationParameters = Input(LocationParameters: string[]..[])
join = String.Join(separator=code_block_2, string0=LocationParameters)
flatten = List.Flatten(list=join)
code_block_3 = CodeBlock(a=CategoryPriority, b=flatten) { a+"_"+b; }
setParameterByName = Element.SetParameterByName(element=ElementsList, parameterName=code_block, value=code_block_3)
Simulationstrings = Output(code_block_3)  # "Simulationstrings:string[]"
