# Dynamo custom node SortLinesandPointsFromStartPoints.dyf (Dynamo 2.2.1.5175)
# category: PracticalBIM.Revit.Elements.MEP.RoutingGrids
# Sorts all lines and end Points from Start Points of Main Line

modifiedlines = Input(modifiedlines: Autodesk.DesignScript.Geometry.Line[])
curvestartpointfrombranchlines = Input(curvestartpointfrombranchlines: Autodesk.DesignScript.Geometry.Point[])
curvestartpointofmainline = Input(curvestartpointofmainline: Autodesk.DesignScript.Geometry.Point[])
distanceTo = Geometry.DistanceTo(geometry=curvestartpointfrombranchlines, other=curvestartpointofmainline, lacing=CrossProduct)
flatten = List.Flatten(list=distanceTo)
sort = List.Sort(list=flatten)
indexOf = List.IndexOf(list=flatten, element=sort)
getItemAtIndex = List.GetItemAtIndex(list=modifiedlines, index=indexOf)
sortedmodifiedlines = Output(getItemAtIndex)  # "sortedmodifiedlines:Autodesk.Geometry.Line[]"
originalpoints = Input(originalpoints: Autodesk.DesignScript.Geometry.Point[])
getItemAtIndex_2 = List.GetItemAtIndex(list=originalpoints, index=indexOf)
sortedoriginalpoints = Output(getItemAtIndex_2)  # "sortedoriginalpoints:Autodesk.Geometry.Point[]"
