# Dynamo custom node SortListofElementsbyString.dyf (Dynamo 2.2.1.5175)
# category: PracticalBIM.Lists.Sort
# Sorts a List of Elements by String Values

listelements = Input(listelements: var[])
liststrings = Input(liststrings: var[])
uniqueItems = List.UniqueItems(list=liststrings)
sort = List.Sort(list=uniqueItems)
allIndicesOf = List.AllIndicesOf(list=liststrings, item=sort)
getItemAtIndex = List.GetItemAtIndex(list=listelements, index=allIndicesOf)
flatten = List.Flatten(list=getItemAtIndex)
var = Output(flatten)  # "var[]..[]"
