# Dynamo custom node SortNumbersandStringsFromGrids.dyf (Dynamo 2.2.1.5175)
# category: PracticalBIM.Lists
# Sorts a List of Numbers and Strings From Grids

str = Input(str: string[])
toNumber = String.ToNumber(str=str)
isNull = Object.IsNull(obj=toNumber)
code_block = CodeBlock { true; }
allIndicesOf = List.AllIndicesOf(list=isNull, item=code_block)
removeItemAtIndex = List.RemoveItemAtIndex(list=toNumber, indices=allIndicesOf)
sort = List.Sort(list=removeItemAtIndex)
string_from_object = FromObject(obj=sort)
getItemAtIndex = List.GetItemAtIndex(list=str, index=allIndicesOf)
sort_2 = List.Sort(list=getItemAtIndex)
join = List.Join(list0=string_from_object, list1=sort_2)
strings = Output(join)  # "strings:string[]"
