# Dynamo custom node SortingPointsFromSortingLines.dyf (Dynamo 2.2.1.5175)
# category: PracticalBIM.Revit.Elements.MEP.RoutingGrids
# Sort Element Points Related to the Sorted Lines

OriginalConectorPoints = Input(OriginalConectorPoints: Autodesk.DesignScript.Geometry.Point[])
SplittedGridLines = Input(SplittedGridLines: Autodesk.DesignScript.Geometry.Line[])
string_from_object = FromObject(obj=SplittedGridLines)
geometryCloseObject = Custom[GeometryCloseObject](geometry=OriginalConectorPoints, other=SplittedGridLines)  # Gets the Closest Object to Geometry
string_from_object_2 = FromObject(obj=geometryCloseObject)
indexOf = List.IndexOf(list=string_from_object, element=string_from_object_2)
sortByKey = List.SortByKey(list=OriginalConectorPoints, keys=indexOf)
SortedOriginalPoints = Output(sortByKey.sorted_list)  # "SortedOriginalPoints:Point[]"
closestPointTo = Geometry.ClosestPointTo(geometry=geometryCloseObject, other=OriginalConectorPoints)
sortByKey_2 = List.SortByKey(list=closestPointTo, keys=indexOf)
OnLineSortedPoints = Output(sortByKey_2.sorted_list)  # "OnLineSortedPoints:Point[]"
SortedKeys = Output(sortByKey_2.sorted_keys)  # "SortedKeys:var[]"
