# Dynamo custom node SortingTwoRandomSetsofLinestoNurbs.dyf (Dynamo 2.2.1.5175)
# category: PracticalBIM.CADImports
# Sorts a random List of lines with a centerline reference to create nurbcurves

Setoftworandomlistofcurves = Input(Setoftworandomlistofcurves: Autodesk.DesignScript.Geometry.Curve[])
flatten = List.Flatten(list=Setoftworandomlistofcurves)
CenterLineofReference = Input(CenterLineofReference: Autodesk.DesignScript.Geometry.Geometry)
startPoint = Curve.StartPoint(curve=Setoftworandomlistofcurves)
closestPointTo = Geometry.ClosestPointTo(geometry=CenterLineofReference, other=startPoint)
distanceTo = Geometry.DistanceTo(geometry=closestPointTo, other=startPoint)
code_block = CodeBlock { 0; }
round = Math.Round(number=distanceTo, digits=code_block)
flatten_2 = List.Flatten(list=round)
code_block_2 = CodeBlock { 30; }
gt = flatten_2 > code_block_2
code_block_3 = CodeBlock { true; }
allIndicesOf = List.AllIndicesOf(list=gt, item=code_block_3)
removeItemAtIndex = List.RemoveItemAtIndex(list=flatten, indices=allIndicesOf)
removeItemAtIndex_2 = List.RemoveItemAtIndex(list=flatten_2, indices=allIndicesOf)
code_block_4 = CodeBlock { 0; 1; }
remapRange = Math.RemapRange(numbers=removeItemAtIndex_2, newMin=code_block_4.out0, newMax=code_block_4.out1)
code_block_5 = CodeBlock { 0; }
round_2 = Math.Round(number=remapRange, digits=code_block_5)
groupByKey = List.GroupByKey(list=removeItemAtIndex, keys=round_2)
sortingSetofLinesbyBestFit = Custom[SortingSetofLinesbyBestFit](listoflinesunsorted=groupByKey.groups)  # Sorts a Set of Lines by Best Fit
resultinglines = Output(sortingSetofLinesbyBestFit)  # "resultinglines:NurbsCurve[]"
