# Dynamo custom node SplitCurvebyaListofCombinationsLessThan3.dyf (Dynamo 2.3.0.5885)
# category: PracticalBIM.GD.Selection
# Splits a Curve by Items of a List of Combinations Lesser than 3

CountofElements = Input(CountofElements: int[])
code_block = CodeBlock { 3; }
le = CountofElements <= code_block
code_block_2 = CodeBlock { true; }
allIndicesOf = List.AllIndicesOf(list=le, item=code_block_2)
SelectedElements = Output(allIndicesOf)  # "SelectedElements:int"
ListofCurves = Input(ListofCurves: Autodesk.DesignScript.Geometry.Curve[])
getItemAtIndex = List.GetItemAtIndex(list=ListofCurves, index=allIndicesOf)
ListofItems = Input(ListofItems: double[]..[])
getItemAtIndex_2 = List.GetItemAtIndex(list=ListofItems, index=allIndicesOf)
count = List.Count(list=getItemAtIndex_2@L2)
code_block_3 = CodeBlock(n=count) { 0..n-1..1; }
code_block_4 = CodeBlock(n=code_block_3) { 0..n..1; }
getItemAtIndex_3 = List.GetItemAtIndex(list=getItemAtIndex_2@L2, index=code_block_4@L3)
sum = Math.Sum(values=getItemAtIndex_3)
pointAtSegmentLength = Curve.PointAtSegmentLength(curve=getItemAtIndex, segmentLength=sum)
splitByPoints = Curve.SplitByPoints(curve=getItemAtIndex, points=pointAtSegmentLength)
ResultingCurves = Output(splitByPoints)  # "ResultingCurves:Curve"
