# Dynamo custom node SplitDuctbySplitPointsSorted.dyf (Dynamo 2.2.1.5175)
# category: PracticalBIM.Revit.Elements.MEP.Ducts
# Splits a Duct by a Series of Points over the Line

Ducttobesplitted = Input(Ducttobesplitted: Revit.Elements.Element)
listofpoints = Input(listofpoints: Autodesk.DesignScript.Geometry.Point[])
list_create = List.Create(item0=Ducttobesplitted, item1=listofpoints)
start = Revit.Transaction.Transaction.Start(input=list_create)
code_block = CodeBlock { 0; }
getItemAtIndex = List.GetItemAtIndex(list=start, index=code_block)
getLocation = Element.GetLocation(element=getItemAtIndex)
code_block_2 = CodeBlock { 1; }
getItemAtIndex_2 = List.GetItemAtIndex(list=start, index=code_block_2)
X = Point.X(point=getItemAtIndex_2)
Y = Point.Y(point=getItemAtIndex_2)
code_block_3 = CodeBlock { 0.5; }
pointAtParameter = Curve.PointAtParameter(curve=getLocation, param=code_block_3)
Z = Point.Z(point=pointAtParameter)
byCoordinates = Point.ByCoordinates(x=X, y=Y, z=Z)
parameterAtPoint = Curve.ParameterAtPoint(curve=getLocation, point=byCoordinates)
sort = List.Sort(list=parameterAtPoint)
indexOf = List.IndexOf(list=parameterAtPoint, element=sort)
getItemAtIndex_3 = List.GetItemAtIndex(list=getItemAtIndex_2, index=indexOf)
splitByPoints = Curve.SplitByPoints(curve=getLocation, points=getItemAtIndex_3)
createDuctbyLineandDuctRectangular = Custom[CreateDuctbyLineandDuctRectangular](Ductelement=getItemAtIndex, DuctLines=splitByPoints)  # Creates a Duct from Lines and a Duct element properties Rectangular
list_create_2 = List.Create(item0=getItemAtIndex, item1=createDuctbyLineandDuctRectangular, item2=indexOf)
end = Revit.Transaction.Transaction.End(input=list_create_2)
code_block_4 = CodeBlock { 0; }
getItemAtIndex_4 = List.GetItemAtIndex(list=end, index=code_block_4)
deleteListofElements = Custom[DeleteListofElements](list=getItemAtIndex_4)  # Deletes a List of Elements
Result = Output(deleteListofElements)
code_block_5 = CodeBlock { 1; }
getItemAtIndex_5 = List.GetItemAtIndex(list=end, index=code_block_5)
RectangularSplittedDucts = Output(getItemAtIndex_5)  # "RectangularSplittedDucts:var[]"
code_block_6 = CodeBlock { 2; }
getItemAtIndex_6 = List.GetItemAtIndex(list=end, index=code_block_6)
SortingOrder = Output(getItemAtIndex_6)  # "SortingOrder:var[]"
