# Dynamo custom node SplitLinebyaGivenLengthofElement.dyf (Dynamo 2.6.1.8786)
# category: PracticalBIM.GD.Splits
# Splits the Line by a Given Length of an Element

curve = Input(curve: Autodesk.DesignScript.Geometry.Curve)
TotalLength = Input(TotalLength: var[]..[])
code_block = CodeBlock(a=TotalLength) { a/2; }
LengthofElement = Input(LengthofElement: var[]..[])
code_block_2 = CodeBlock(a=TotalLength, b=LengthofElement) { a/b; }
floor = Math.Floor(number=code_block_2)
code_block_3 = CodeBlock(a=floor) { a/2; }
code_block_4 = CodeBlock(a=code_block_3, b=LengthofElement) { a*b; }
code_block_5 = CodeBlock(a=code_block, b=code_block_4) { a-b; }
code_block_6 = CodeBlock(a=floor) { a+1; }
code_block_7 = CodeBlock(a=code_block_5, b=code_block_6, c=LengthofElement) { a..#b..c; }
pointAtSegmentLength = Curve.PointAtSegmentLength(curve=curve, segmentLength=code_block_7)
ResultingLocations = Output(pointAtSegmentLength)  # "ResultingLocations:Point[]"
Remainder = Output(code_block_5)  # "Remainder:double"
