# Dynamo custom node StirrupPolycurveandlinefromTopBottomandLongsidefaces.dyf (Dynamo 2.2.1.5175)
# category: PracticalBIM.Rebar.Geometry
# Gets the Stirrup Polycurve from the Top Bottom and Long Side faces

smallsidesurface = Input(smallsidesurface: Autodesk.DesignScript.Geometry.Surface[])
smallsidedistance = Input(smallsidedistance: double)
surfaceOffsetedtoinversedNormalbydistanc = Custom[SurfaceOffsetedtoinversedNormalbydistance](surface=smallsidesurface, distance=smallsidedistance)  # Creates a surface offseted to inversed normal by a distance
code_block = CodeBlock { 0; }
getItemAtIndex = List.GetItemAtIndex(list=surfaceOffsetedtoinversedNormalbydistanc, index=code_block)
code_block_2 = CodeBlock { 0.5; }
pointAtParameter = Surface.PointAtParameter(surface=getItemAtIndex, u=code_block_2, v=code_block_2)
code_block_3 = CodeBlock { 1; }
getItemAtIndex_2 = List.GetItemAtIndex(list=surfaceOffsetedtoinversedNormalbydistanc, index=code_block_3)
pointAtParameter_2 = Surface.PointAtParameter(surface=getItemAtIndex_2, u=code_block_2, v=code_block_2)
byStartPointEndPoint = Line.ByStartPointEndPoint(startPoint=pointAtParameter, endPoint=pointAtParameter_2)
Line = Output(byStartPointEndPoint)
topsurface = Input(topsurface: Autodesk.DesignScript.Geometry.Surface)
topdistance = Input(topdistance: double)
surfaceOffsetedtoinversedNormalbydistanc_2 = Custom[SurfaceOffsetedtoinversedNormalbydistance](surface=topsurface, distance=topdistance)
bottomsurface = Input(bottomsurface: Autodesk.DesignScript.Geometry.Surface)
bottomdistance = Input(bottomdistance: double)
surfaceOffsetedtoinversedNormalbydistanc_3 = Custom[SurfaceOffsetedtoinversedNormalbydistance](surface=bottomsurface, distance=bottomdistance)
join = List.Join(list0=surfaceOffsetedtoinversedNormalbydistanc_2, list1=surfaceOffsetedtoinversedNormalbydistanc_3)
intersect = Geometry.Intersect(geometry=getItemAtIndex, other=join, lacing=CrossProduct)
flatten = List.Flatten(list=intersect)
sideoffset = Input(sideoffset: double)
length = Curve.Length(curve=flatten)
code_block_4 = CodeBlock(a=sideoffset, b=length) { a..b-a..#2; }
pointAtSegmentLength = Curve.PointAtSegmentLength(curve=flatten, segmentLength=code_block_4)
flatten_2 = List.Flatten(list=pointAtSegmentLength)
byPerimeterPoints = Surface.ByPerimeterPoints(points=flatten_2)
perimeterCurves = Surface.PerimeterCurves(surface=byPerimeterPoints)
byJoinedCurves = PolyCurve.ByJoinedCurves(curves=perimeterCurves)
PolyCurve = Output(byJoinedCurves)
