# Dynamo custom node SurfaceOffsetedtoinversedNormalbydistance.dyf (Dynamo 2.2.1.5175)
# category: PracticalBIM.Rebar.Geometry
# Creates a surface offseted to inversed normal by a distance

surface = Input(surface: Autodesk.DesignScript.Geometry.Surface[])
code_block = CodeBlock { 0.5; }
normalAtParameter = Surface.NormalAtParameter(surface=surface, u=code_block, v=code_block)
reverse = Vector.Reverse(vector=normalAtParameter)
distance = Input(distance: double)
translate = Geometry.Translate(geometry=surface, direction=reverse, distance=distance)
Geometry_Surface = Output(translate)  # "Geometry.Surface[]"
