# Dynamo custom node SurfacetoPlaneandVector.dyf (Dynamo 2.6.1.8786)
# category: PracticalBIM.Geometry.Surfaces
# Transforms a Surface to a Plane with a Vector

surface = Input(surface: Autodesk.DesignScript.Geometry.Surface)
code_block = CodeBlock { 0.5; }
normalAtParameter = Surface.NormalAtParameter(surface=surface, u=code_block, v=code_block)
NormalVector = Output(normalAtParameter)  # "NormalVector:Vector"
pointAtParameter = Surface.PointAtParameter(surface=surface, u=code_block, v=code_block)
byOriginNormal = Plane.ByOriginNormal(origin=pointAtParameter, normal=normalAtParameter)
SurfacePlane = Output(byOriginNormal)  # "SurfacePlane:Plane"
