# Dynamo custom node TopologyLaticetoCentroidbyRadius.dyf (Dynamo 2.2.1.5175)
# category: PracticalBIM.Geometry.Abstract.Topology
# Creates an Inner Latice of Elements to Centroid

solid = Input(solid: Autodesk.DesignScript.Geometry.Solid)
centroid = Solid.Centroid(solid=solid)
vertices = Topology.Vertices(topology=solid)
pointGeometry = Vertex.PointGeometry(vertex=vertices)
byStartPointEndPoint = Line.ByStartPointEndPoint(startPoint=centroid, endPoint=pointGeometry)
code_block = CodeBlock { [0,1]; }
planeAtParameter = Curve.PlaneAtParameter(curve=byStartPointEndPoint, param=code_block, lacing=CrossProduct)
radius = Input(radius: double)
byPlaneRadius = Circle.ByPlaneRadius(plane=planeAtParameter, radius=radius)
byLoft = Solid.ByLoft(crossSections=byPlaneRadius)
Solid = Output(byLoft)
Line = Output(byStartPointEndPoint)
