# Dynamo custom node TransferPointsRelatedToLinetoOtherLines.dyf (Dynamo 2.6.1.8786)
# category: PracticalBIM.Geometry.Modifiers
# Transfer a list of Points Related to a Line to Other Lines
# packages: PracticalBIM 2020.0.35, PracticalBIM 2020.0.38

NewLines = Input(NewLines: Autodesk.DesignScript.Geometry.Line[])
direction = Line.Direction(line=NewLines)
getAngleofRotationofFamilyInstanceX = Custom[GetAngleofRotationofFamilyInstanceX](OrientationVector=direction)  # Gets the Angle of Rotation of a Family Instance Drawn on X Grid
Angle = Output(getAngleofRotationofFamilyInstanceX)  # "Angle:double"
PointstoTransfer = Input(PointstoTransfer: Autodesk.DesignScript.Geometry.Point[])
Relatedline = Input(Relatedline: Autodesk.DesignScript.Geometry.Line)
direction_2 = Line.Direction(line=Relatedline)
closestPointTo = Geometry.ClosestPointTo(geometry=Relatedline, other=PointstoTransfer)
coordinateSystembyPointandVectorOveraCur = Custom[CoordinateSystembyPointandVectorOveraCurveforLinearFamilies](vector=direction_2, origin=closestPointTo, lacing=Longest)  # package PracticalBIM; Creates a Coordinate System on Everypoint with Vectors over a Curve
flatten = List.Flatten(list=coordinateSystembyPointandVectorOveraCur)
parameterAtPoint = Curve.ParameterAtPoint(curve=Relatedline, point=closestPointTo)
segmentLengthAtParameter = Curve.SegmentLengthAtParameter(curve=Relatedline, param=parameterAtPoint)
pointAtSegmentLength = Curve.PointAtSegmentLength(curve=NewLines, segmentLength=segmentLengthAtParameter, lacing=CrossProduct)
count = List.Count(list=pointAtSegmentLength@L2)
ofRepeatedItem = List.OfRepeatedItem(item=direction, amount=count, lacing=Shortest)
coordinateSystembyPointandVectorOveraCur_2 = Custom[CoordinateSystembyPointandVectorOveraCurveforLinearFamilies](vector=ofRepeatedItem, origin=pointAtSegmentLength, lacing=Longest)
transform = Geometry.Transform(geometry=PointstoTransfer, fromCoordinateSystem=flatten, contextCoordinateSystem=coordinateSystembyPointandVectorOveraCur_2@L2)
ResultantPoints = Output(transform)  # "ResultantPoints:Point"
getAngleofRotationofFamilyInstance = Custom[GetAngleofRotationofFamilyInstance](OrientationVector=direction)  # package PracticalBIM; Gets the Angle of Rotation of a Family Instance
AngleY = Output(getAngleofRotationofFamilyInstance)  # "AngleY:double"
