# Dynamo custom node TransferPropertyFromParameterNames.dyf (Dynamo 2.2.1.5175)
# category: PracticalBIM.Revit.Elements.Element
# Transfer a Property from one parameter to the other

element = Input(element: Revit.Elements.Element)
NewParameterName = Input(NewParameterName: string)
OriginalParameterName = Input(OriginalParameterName: string)
getParameterValueByName = Element.GetParameterValueByName(element=element, parameterName=OriginalParameterName)
setParameterByName = Element.SetParameterByName(element=element, parameterName=NewParameterName, value=getParameterValueByName)
Element = Output(setParameterByName)
