# Dynamo custom node VectorfromCentroidtoCropView.dyf (Dynamo 2.2.1.5175)
# category: PracticalBIM.Geometry.Abstract.BoundingBox
# Creates a Vector from a Centroid of Bounding Box to a Crop Box

curves = Input(curves: Autodesk.DesignScript.Geometry.Curve[]..[])
byJoinedCurves = PolyCurve.ByJoinedCurves(curves=curves)
byPatch = Surface.ByPatch(closedCurve=byJoinedCurves)
code_block = CodeBlock { 0.5; }
normalAtParameter = Surface.NormalAtParameter(surface=byPatch, u=code_block, v=code_block)
Vector = Output(normalAtParameter)  # "Vector[]"
