# Dynamo custom node Vectorofalinegoingdown.dyf (Dynamo 2.2.1.5175)
# category: PracticalBIM.Geometry.Abstract.Vector
# Gets the vector of a line going down

curve = Input(curve: Autodesk.DesignScript.Geometry.Curve)
startPoint = Curve.StartPoint(curve=curve)
Z = Point.Z(point=startPoint)
endPoint = Curve.EndPoint(curve=curve)
Z_2 = Point.Z(point=endPoint)
gt = Z > Z_2
direction = Line.Direction(line=curve)
reverse = Vector.Reverse(vector=direction)
if_ = If(test=gt, true=direction, false=reverse)
result = Output(if_)  # "result:Vector"
