# Dynamo custom node VentilationConnectionToptoPipeLine.dyf (Dynamo 2.2.1.5175)
# category: PracticalBIM.Revit.Elements.MEP.Ventilation
# Creates Lines for elements to connect from a Top Connector to a Pipe Line

connectorradius = Input(connectorradius: double[])
ConnectedElements = Input(ConnectedElements: Revit.Elements.Element[])
getCategory = Element.GetCategory(element=ConnectedElements)
name = Category.Name(category=getCategory)
code_block = CodeBlock { "Piping Systems"; }
allIndicesOf = List.AllIndicesOf(list=name, item=code_block)
radius = List.GetItemAtIndex(list=connectorradius, index=allIndicesOf)
connectorvector = Input(connectorvector: Autodesk.DesignScript.Geometry.Vector[])
vectors = List.GetItemAtIndex(list=connectorvector, index=allIndicesOf)
connectorpoints = Input(connectorpoints: Autodesk.DesignScript.Geometry.Point[])
points = List.GetItemAtIndex(list=connectorpoints, index=allIndicesOf)
X = Point.X(point=points)
Y = Point.Y(point=points)
pipeline = Input(pipeline: Revit.Elements.Element)
getLocation = Element.GetLocation(element=pipeline)
startPoint = Curve.StartPoint(curve=getLocation)
Z = Point.Z(point=startPoint)
byCoordinates = Point.ByCoordinates(x=X, y=Y, z=Z)
line1 = Line.ByStartPointEndPoint(startPoint=points, endPoint=byCoordinates)
flatten = List.Flatten(list=line1)
Line1 = Output(flatten)  # "Line1:Line[]"
closestPointTo = Geometry.ClosestPointTo(geometry=getLocation, other=byCoordinates)
line_2 = Line.ByStartPointEndPoint(startPoint=byCoordinates, endPoint=closestPointTo)
flatten_2 = List.Flatten(list=line_2)
Line2 = Output(flatten_2)  # "Line2:Line[]"
