# Dynamo custom node WallSplitingSurfacesbyWithforFormwork.dyf (Dynamo 2.2.1.5175)
# category: PracticalBIM.Revit.Elements.Wall
# Splits Wall Elements by its Voids to Create Splitted Surfaces with formwork

wallelement = Input(wallelement: Revit.Elements.Element[])
wallGetProfilewithVoids = Custom[WallGetProfilewithVoids](element=wallelement)  # Gets the wall profile from a revit element
perimeterCurves = Surface.PerimeterCurves(surface=wallGetProfilewithVoids)
verticalSlicingLinesFromVoids = Custom[VerticalSlicingLinesFromVoids](curve=perimeterCurves)  # Creates Vertical Slicing Lines from Voids to Create squared Formwork
splitSurfacebyLines = Custom[SplitSurfacebyLines](surfacetodivide=wallGetProfilewithVoids, linesfordivision=verticalSlicingLinesFromVoids)  # Splits a Surface by a list of lines
code_block = CodeBlock { 0.5; }
normalAtParameter = Surface.NormalAtParameter(surface=splitSurfacebyLines, u=code_block, v=code_block)
code_block_2 = CodeBlock { "Type"; }
getParameterValueByName = Element.GetParameterValueByName(element=wallelement, parameterName=code_block_2)
code_block_3 = CodeBlock { "Width"; }
getParameterValueByName_2 = Element.GetParameterValueByName(element=getParameterValueByName, parameterName=code_block_3)
code_block_4 = CodeBlock(a=getParameterValueByName_2) { a/2; }
translate = Geometry.Translate(geometry=splitSurfacebyLines, direction=normalAtParameter, distance=code_block_4)
flatten = List.Flatten(list=translate)
reverse = Vector.Reverse(vector=normalAtParameter)
translate_2 = Geometry.Translate(geometry=splitSurfacebyLines, direction=reverse, distance=code_block_4)
flatten_2 = List.Flatten(list=translate_2)
join = List.Join(list0=flatten, list1=flatten_2)
FinishedSurfaces = Output(join)  # "FinishedSurfaces[]..[]"
