# Dynamo custom node Profile From Revit.dyf (Dynamo 0.7.1.40372)
# category: EPR
# Make a polycurve from several Revit entities taken via Select Multiple Elements. If only one element is selected it will return the individual curve. It can make several polycurves at once.

code_block = CodeBlock()
# ---------- code_block.designscript (9 lines) ----------
def MakeProfile(RevLines:var[])
{
Lin=Flatten( RevLines.Geometry() );
NumLin=Count(Lin);
Profile=NumLin>1?PolyCurve.ByJoinedCurves(Lin):
Lin[0];

return=Profile;
}
# ----------------------------------------
Revit_Lin = Input()  # "Revit Lin."
code_block_2 = CodeBlock(RL=Revit_Lin) { MakeProfile(   List.Flatten({RL},1)  ); }
Profile = Output(code_block_2)
