# Dynamo graph collect-elements-from-link-document.dyn (Dynamo 2.5.0.7460)
# packages: QuasarII 1.0.0

categories = Categories("OST_Walls")
link_documents = LinkDocUIDropDown("rac_basic_sample_project.rvt ")
getElementFromLinkDocument = QuasarII.LinkDocument.GetElementFromLinkDocument(Category=categories, Document=link_documents)
