# Dynamo graph ceiling-plan-views-by-rooms.dyn (Dynamo 2.5.0.7460)
# packages: QuasarII 1.0.0

categories = Categories("OST_Rooms")
all_elements_of_category = ElementsOfCategory(Category=categories)
number = Room.Number(room=all_elements_of_category)
name = Room.Name(room=all_elements_of_category)
code_block = CodeBlock(number=number, name=name) { number+"_"+name; }
ceilingplan_viewfamilytype = CeilingPlanVFTypeUIDropDown("Ceiling Plan")
code_block_2 = CodeBlock { 50; 500; }
createPlanViewsByRooms = QuasarII.ViewUtility.CreatePlanViewsByRooms(Rooms=all_elements_of_category, Names=code_block, viewFamilyType=ceilingplan_viewfamilytype, Scale=code_block_2.out0, Offset=code_block_2.out1)
