# Dynamo graph add-spaces-to-zone.dyn (Dynamo 2.5.0.7460)
# packages: QuasarII 1.0.0

zones = ZoneUIDropDown("RHS Zone")
zones_2 = ZoneUIDropDown("LHS Zone")
getSpacesByZone = QuasarII.MEPSpaces.GetSpacesByZone(zone=zones_2)
# note: Add Space(s) to a Zone.
# ZoneUtility.AddSpacesToZone (zone: var, Spaces: Element ...
addSpacesToZone = QuasarII.ZoneUtility.AddSpacesToZone(zone=zones, Spaces=getSpacesByZone)
