# Dynamo graph center-room-tags.dyn (Dynamo 2.5.0.7460)
# packages: QuasarII 1.0.0

views = Views("Level 1")
categories = Categories("OST_RoomTags")
all_elements_of_category = ElementsOfCategory(Category=categories)
roomTagToRoom = QuasarII.RoomUtility.RoomTagToRoom(view=views, RoomTags=all_elements_of_category)
