# Dynamo graph hide-unhide-elements.dyn (Dynamo 2.5.0.7460)
# packages: QuasarII 1.0.0

select_model_elements = DSModelElementsSelection()  # 18 picked in the model
views = Views("Level 1")
views_2 = Views("Level 2")
list_create = List.Create(item0=views, item1=views_2)
boolean = BoolSelector(true)
# note: Hide/Unhide a list of Element(s) in the given View(s).
# ElementGraphics.HideUnhi ...
hideUnhideElementsInViews = QuasarII.ElementGraphics.HideUnhideElementsInViews(Elements=select_model_elements, Views=list_create, HideUnhide=boolean)
