# Dynamo custom node RIE_ActiveView.dyf (Dynamo 1.3.4.6666)
# category: RIE.Views
# Returns active view in current document.

Refresh = Input(Refresh : var = true)
python_script = Python(IN[0]=Refresh)
# ---------- python_script.python (12 lines) ----------
# @ Copyright - Designed by André Abotnes andre.abotnes@norconsult.com
import clr
# Import DocumentManager and TransactionManager
clr.AddReference('RevitServices')
import RevitServices
from RevitServices.Persistence import DocumentManager

if IN[0]:
	pass
doc = DocumentManager.Instance.CurrentDBDocument

OUT = doc.ActiveView
# ----------------------------------------
ActiveView = Output(python_script)
