# Dynamo custom node RIE_BBoxByElements.dyf (Dynamo 2.3.0.5885)
# category: RIE.Elements
# Creates a boundingbox from a set of elements

elements = Input(elements: var[]..[])
type = Object.Type(obj=elements)
code_block = CodeBlock { "UnknownElement"; }
contains = String.Contains(str=type, searchFor=code_block)
filterByBoolMask = List.FilterByBoolMask(list=elements, mask=contains)
boundingBox = Element.BoundingBox(element=filterByBoolMask.out)
minPoint = BoundingBox.MinPoint(boundingBox=boundingBox)
maxPoint = BoundingBox.MaxPoint(boundingBox=boundingBox)
join = List.Join(list0=minPoint, list1=maxPoint)
isNull = Object.IsNull(obj=join)
filterByBoolMask_2 = List.FilterByBoolMask(list=join, mask=isNull)
byGeometry = BoundingBox.ByGeometry(geom=filterByBoolMask_2.out)
BBox = Output(byGeometry)
