# Dynamo custom node RIE_BBoxFromPlanView.dyf (Dynamo 2.3.0.5885)
# category: RIE.Geometry
# Retrieves boundingbox from active view based on viewrange settins

views = Input(views: var[]..[])
python_script = Python(IN[0]=views)
# ---------- python_script.python (66 lines) ----------
import clr





clr.AddReference('ProtoGeometry')
from Autodesk.DesignScript.Geometry import*

clr.AddReference("RevitNodes")
import Revit
clr.ImportExtensions(Revit.Elements)
clr.ImportExtensions(Revit.GeometryConversion)

clr.AddReference('RevitServices')
from RevitServices.Persistence import DocumentManager
import System
from System.Collections.Generic import *

clr.AddReference("RevitAPI")
from Autodesk.Revit.DB import*
from Autodesk.Revit.DB import FilteredElementCollector, RevitLinkType

def tolist(obj1):
	if hasattr(obj1,"__iter__"): return obj1
	else: return [obj1]
	
ft = 304.8

doc = DocumentManager.Instance.CurrentDBDocument
UIunit = Document.GetUnits(doc).GetFormatOptions(UnitType.UT_Length).DisplayUnits

OUT = []

if IN[0] == None:
	views = tolist(doc.ActiveView)
else:
	views = tolist(UnwrapElement(IN[0]))

for v in views:
	bb = v.CropBox
	vr = v.GetViewRange()
	topclip = PlanViewPlane.TopClipPlane
	bottomclip = PlanViewPlane.BottomClipPlane
	cutclip = PlanViewPlane.CutPlane
	toplevel = (doc.GetElement(vr.GetLevelId(topclip)))
	topoffset = vr.GetOffset(topclip)
	cutlevel = (doc.GetElement(vr.GetLevelId(cutclip)))
	cutoffset = vr.GetOffset(cutclip)
	bottomoffset = vr.GetOffset(bottomclip)
	try:
		topZ = toplevel.Elevation + topoffset
	except:
		topZ = cutlevel.Elevation + cutoffset
		bottomlevel = (doc.GetElement(vr.GetLevelId(bottomclip)))
		bottomoffset = vr.GetOffset(bottomclip)
	try:
		bottomZ = bottomlevel.Elevation + bottomoffset
	except :
		bottomZ = cutlevel.Elevation + bottomoffset
		min = bb.Min
		max = bb.Max
		newmin = XYZ(UnitUtils.ConvertToInternalUnits(min.X,UIunit)*ft,UnitUtils.ConvertToInternalUnits(min.Y,UIunit)*ft,bottomZ)
		newmax = XYZ(UnitUtils.ConvertToInternalUnits(max.X,UIunit)*ft,UnitUtils.ConvertToInternalUnits(max.Y,UIunit)*ft,topZ)
		#OUT.append(Outline(newmin,newmax).ToRevitType())
	OUT.append([newmin.ToPoint(),newmax.ToPoint()])
# ----------------------------------------
code_block = CodeBlock { 0; 1; }
getItemAtIndex = List.GetItemAtIndex(list=python_script@L2, index=code_block.out0)
getItemAtIndex_2 = List.GetItemAtIndex(list=python_script@L2, index=code_block.out1)
byCorners = BoundingBox.ByCorners(min=getItemAtIndex, max=getItemAtIndex_2)
BBox = Output(byCorners)
