# Dynamo custom node RIE_BBox_StretchZ.dyf (Dynamo 2.3.0.5885)
# category: RIE.Geometry
# Stretch the boundingbox in Z directions.
# packages: RIE 2020.11.18

BBox = Input(BBox: var[]..[])
minPoint = BoundingBox.MinPoint(boundingBox=BBox)
deconstructPoint = Custom[RIE.DeconstructPoint](point=minPoint)  # package RIE; Deconstructs points into their X, Y and Z values. Idea stolen from Lunchbox's equivalent node.
DownAmount = Input(DownAmount: var[]..[])
sub = deconstructPoint.Z - DownAmount
byCoordinates = Point.ByCoordinates(x=deconstructPoint.X, y=deconstructPoint.Y, z=sub)
maxPoint = BoundingBox.MaxPoint(boundingBox=BBox)
deconstructPoint_2 = Custom[RIE.DeconstructPoint](point=maxPoint)
UpAmount = Input(UpAmount: var[]..[])
add = deconstructPoint_2.Z + UpAmount
byCoordinates_2 = Point.ByCoordinates(x=deconstructPoint_2.X, y=deconstructPoint_2.Y, z=add)
byCorners = BoundingBox.ByCorners(min=byCoordinates, max=byCoordinates_2)
BBox_2 = Output(byCorners)  # "BBox"
