# Dynamo custom node RIE_Curve_Rotation_XY.dyf (Dynamo 2.3.0.5885)
# category: RIE.Geometry
# Find the XY Rotation component of a line

curve = Input(curve: Autodesk.DesignScript.Geometry.Curve)
startPoint = Curve.StartPoint(curve=curve)
Z = Point.Z(point=startPoint)
endPoint = Curve.EndPoint(curve=curve)
Z_2 = Point.Z(point=endPoint)
code_block = CodeBlock(sp=Z, ep=Z_2) { sp-ep; }
abs = Math.Abs(number=code_block)
length = Curve.Length(curve=curve)
code_block_2 = CodeBlock(katet=abs, hypotenus=length) { katet/hypotenus; }
asin = Math.Asin(ratio=code_block_2)
angleXY = Output(asin)
