# Dynamo custom node RIE_Curve_Rotation_XZ.dyf (Dynamo 2.3.0.5885)
# category: RIE.Geometry
# Find the XZ rotation component of a line

XAxis = Vector.XAxis()
curve = Input(curve: Autodesk.DesignScript.Geometry.Curve)
startPoint = Curve.StartPoint(curve=curve)
X = Point.X(point=startPoint)
Y = Point.Y(point=startPoint)
byCoordinates = Point.ByCoordinates(x=X, y=Y)
endPoint = Curve.EndPoint(curve=curve)
X_2 = Point.X(point=endPoint)
Y_2 = Point.Y(point=endPoint)
byCoordinates_2 = Point.ByCoordinates(x=X_2, y=Y_2)
byStartPointEndPoint = Line.ByStartPointEndPoint(startPoint=byCoordinates, endPoint=byCoordinates_2)
direction = Line.Direction(line=byStartPointEndPoint)
ZAxis = Vector.ZAxis()
angleAboutAxis = Vector.AngleAboutAxis(vector=XAxis, otherVector=direction, rotationAxis=ZAxis)
angleXZ = Output(angleAboutAxis)
