# Dynamo custom node RIE_DistinguishableColors.dyf (Dynamo 1.3.3.4651)
# category: RIE.List
# Just a simple list of distinguishable colors.

code_block = CodeBlock()
# ---------- code_block.designscript (19 lines) ----------
{Color.ByARGB(0, 230, 25, 75),
Color.ByARGB(0, 60, 180, 75),
Color.ByARGB(0, 255, 225, 25),
Color.ByARGB(0, 0, 130, 200),
Color.ByARGB(0, 245, 130, 48),
Color.ByARGB(0, 145, 30, 180),
Color.ByARGB(0, 70, 240, 240),
Color.ByARGB(0, 240, 50, 230),
Color.ByARGB(0, 210, 245, 60),
Color.ByARGB(0, 250, 190, 190),
Color.ByARGB(0, 0, 128, 128),
Color.ByARGB(0, 230, 190, 255),
Color.ByARGB(0, 170, 110, 40),
Color.ByARGB(0, 255, 250, 200),
Color.ByARGB(0, 128, 0, 0),
Color.ByARGB(0, 170, 255, 195),
Color.ByARGB(0, 128, 128, 0),
Color.ByARGB(0, 255, 215, 180),
Color.ByARGB(0, 0, 0, 128)};
# ----------------------------------------
Colors = Output(code_block)
