# Dynamo custom node RIE_ElementToWorksetByWorksetName.dyf (Dynamo 2.3.0.5885)
# category: RIE.Elements

element = Input(element: var[]..[])
code_block = CodeBlock { "Workset"; }
python_script = Python()
# ---------- python_script.python (35 lines) ----------
import clr
clr.AddReference('ProtoGeometry')
from Autodesk.DesignScript.Geometry import *

# Import DocumentManager
clr.AddReference("RevitServices")
import RevitServices
from RevitServices.Persistence import DocumentManager

# Import RevitAPI
clr.AddReference("RevitAPI")
import Autodesk

# Import ToDSType(bool) extension method
clr.AddReference("RevitNodes")
import Revit
from Autodesk.Revit.DB import *
clr.ImportExtensions(Revit.Elements)

#The inputs to this node will be stored as a list in the IN variable.
#doc = DocumentManager.Instance.CurrentDBDocument
uiapp = DocumentManager.Instance.CurrentUIApplication
app = uiapp.Application
doc = DocumentManager.Instance.CurrentDBDocument

#create workset collector
userWorksets = FilteredWorksetCollector(doc).OfKind(WorksetKind.UserWorkset)

names, ids = [], []
for i in userWorksets:
	names.append(i.Name)
	ids.append(i.Id.IntegerValue)

#Assign your output to the OUT variable
OUT = names, ids
# ----------------------------------------
code_block_2 = CodeBlock(a=python_script) { a[1]; a[0]; }
worksetName = Input(worksetName: var[]..[])
firstIndexOf = List.FirstIndexOf(list=code_block_2.out1, item=worksetName)
getItemAtIndex = List.GetItemAtIndex(list=code_block_2.out0, index=firstIndexOf)
setParameterByName = Element.SetParameterByName(element=element, parameterName=code_block, value=getItemAtIndex)
Element = Output(setParameterByName)
