# Dynamo custom node RIE_ElementsOfCategoryIntersectingElement.dyf (Dynamo 1.3.3.4651)
# category: RIE.Elements
# Retrieves all elements of input category that intersects with input element. Can also be linked elements. If Category is not input, all categories will be checked.

Elements = Input()
Cat = Input(Cat : var = null)
buildinCategoryFromCategory = Custom[RIE.BuildinCategoryFromCategory](Cat=Cat@L1)  # Returns the OST builtincategory from input category.
LinkOptional = Input(LinkOptional : var = null)
linkDocFromLink = Custom[RIE.LinkDocFromLink](LinkInstance=LinkOptional)  # Retrieves link Document element from link element.
python_script = Python(IN[0]=Elements, IN[1]=buildinCategoryFromCategory, IN[2]=linkDocFromLink)
# ---------- python_script.python (51 lines) ----------
# RETRIEVED FROM EINAR RAKNES ON THE DYNAMOBIM.ORG FORUMS.

import clr
clr.AddReference('RevitAPI')
clr.AddReference('RevitNodes')
clr.AddReference('RevitServices')
import Revit
import RevitServices
from Autodesk.Revit.DB import *
from RevitServices.Persistence import DocumentManager
clr.ImportExtensions(Revit.Elements)
clr.ImportExtensions(Revit.GeometryConversion)

doc = DocumentManager.Instance.CurrentDBDocument

if IN[2] != None:
	doc = UnwrapElement(IN[2])

def tolist(obj):
	if isinstance(obj,list):
		return UnwrapElement(obj)
	else:
		return [UnwrapElement(obj)]

#Preparing input from dynamo to revit
els = tolist(IN[0])
OUT = []

for el in els:
	if IN[1][0] != None:
		for builtinc in tolist(IN[1]):
			elems = []
		
			filter = ElementIntersectsElementFilter(el)
			
			collector = FilteredElementCollector(doc).WherePasses(filter).OfCategory(builtinc)
			
			elems = [e.ToDSType(True) for e in collector]
			OUT.append(elems)
	else:
		elems = []
		
		filter = ElementIntersectsElementFilter(el)
			
		collector = FilteredElementCollector(doc).WherePasses(filter)
			
		elems = [e.ToDSType(True) for e in collector]
		OUT.append(elems)
		
if len(OUT) == 1:
	OUT = OUT[0]
# ----------------------------------------
Elements_2 = Output(python_script)  # "Elements"
