# Dynamo custom node RIE_ElementsOnSheet.dyf (Dynamo 2.3.0.5885)
# category: RIE.Views
# Input Sheet and retrieve all elements. This nodes get all elementIds by performing a deletion of the sheet, then undoing the transaction whilst retrieving all deleted elementIds, then retrieves all the elements that were restored.
# Therefore the sheets you input must be closed in the UI, or they cannot be deleted, hence this node will output null.

sheets = Input(sheets: var[]..[])
elements_on_sheet_python = Python(IN[0]=sheets)
# ---------- elements_on_sheet_python.python (67 lines) ----------
import clr
clr.AddReference('ProtoGeometry')
from Autodesk.DesignScript.Geometry import *

# Import ToDSType(bool) extension method
clr.AddReference('RevitNodes')
import Revit
clr.ImportExtensions(Revit.Elements)

# Import DocumentManager and TransactionManager
clr.AddReference('RevitServices')
import RevitServices
from RevitServices.Persistence import DocumentManager
from RevitServices.Transactions import TransactionManager

# Import RevitAPI
clr.AddReference('RevitAPI')
import Autodesk
from Autodesk.Revit.DB import *


doc = DocumentManager.Instance.CurrentDBDocument

#The inputs to this node will be stored as a list in the IN variable.
dataEnteringNode = IN

OUT = []
elements = []
inputids = []

def tolist(obj):
	if isinstance(obj,list):
		return obj
	else:
		return [obj]

for i in tolist(IN[0]):
	elements.append(UnwrapElement(i))

TransactionManager.Instance.EnsureInTransaction(doc)

schName, schId, ids = [], [], []
for i in elements:
	try:
		trans = SubTransaction(doc)
		inputids.append(i.Id)
		trans.Start()
		ids.append(doc.Delete(i.Id))
		trans.RollBack()
	except:
		ids.append([])
		continue

		
TransactionManager.Instance.TransactionTaskDone()



for i in ids:
	elementsOnSheet = []
	elementsOnSheet1 = []
	if len(i) == 0:
		OUT.append([])
	for j in i:
		elementsOnSheet.append(doc.GetElement(j).GetType())
		elementsOnSheet1.append(doc.GetElement(j))
	OUT.append(elementsOnSheet1)
# ----------------------------------------
Elements = Output(elements_on_sheet_python)
