# Dynamo custom node RIE_GetAllUserWorksets.dyf (Dynamo 2.3.0.5885)
# category: RIE.Elements
# Retrieves all user created worksets in the document.

python_script = Python()
# ---------- python_script.python (37 lines) ----------
# Copied from a post by Nick_Boyts on the Dynamo forums

import clr
clr.AddReference('ProtoGeometry')
from Autodesk.DesignScript.Geometry import *

# Import DocumentManager
clr.AddReference("RevitServices")
import RevitServices
from RevitServices.Persistence import DocumentManager

# Import RevitAPI
clr.AddReference("RevitAPI")
import Autodesk

# Import ToDSType(bool) extension method
clr.AddReference("RevitNodes")
import Revit
from Autodesk.Revit.DB import *
clr.ImportExtensions(Revit.Elements)

#The inputs to this node will be stored as a list in the IN variable.
#doc = DocumentManager.Instance.CurrentDBDocument
uiapp = DocumentManager.Instance.CurrentUIApplication
app = uiapp.Application
doc = DocumentManager.Instance.CurrentDBDocument

#create workset collector
userWorksets = FilteredWorksetCollector(doc).OfKind(WorksetKind.UserWorkset)

names, ids = [], []
for i in userWorksets:
	names.append(i.Name)
	ids.append(i.Id.IntegerValue)

#Assign your output to the OUT variable
OUT = names, ids
# ----------------------------------------
code_block = CodeBlock(a=python_script) { a[0]; a[1]; }
name = Output(code_block.out0)
id = Output(code_block.out1)
