# Dynamo custom node RIE_GetAllViewTemplates.dyf (Dynamo 1.3.2.2480)
# category: RIE.Views
# Gets all view templates. Forked from SpringNodes

boolean = BoolSelector(true)
python_script = Python(IN[0]=boolean)
# ---------- python_script.python (49 lines) ----------
# Copyright(c) 2016, Konrad K Sobon
# @arch_laboratory, http://archi-lab.net

# Import DocumentManager and TransactionManager
import clr
clr.AddReference("RevitServices")
import RevitServices
from RevitServices.Persistence import DocumentManager
from RevitServices.Transactions import TransactionManager
doc = DocumentManager.Instance.CurrentDBDocument

# Import RevitAPI
clr.AddReference("RevitAPI")
import Autodesk
from Autodesk.Revit.DB import *

import sys
pyt_path = r'C:\Program Files (x86)\IronPython 2.7\Lib'
sys.path.append(pyt_path)

#The inputs to this node will be stored as a list in the IN variable.
dataEnteringNode = IN
a=[]
if IN[0]:
	try:
		errorReport = None
		TransactionManager.Instance.EnsureInTransaction(doc)
		
		allViewTemp = FilteredElementCollector(doc).OfClass(View).ToElements()
		toDelete = []
		for i in allViewTemp:
			if i.IsTemplate:
				try:
					a.append(i)
				except:
					pass

		TransactionManager.Instance.TransactionTaskDone()
	except:
		# if error accurs anywhere in the process catch it
		import traceback
		errorReport = traceback.format_exc()
else:
	errorReport = "Set input to True"
#Assign your output to the OUT variable
if errorReport == None:
	OUT = a
else:
	OUT = errorReport
# ----------------------------------------
isNull = Object.IsNull(python_script)
code_block = CodeBlock(a=isNull) { a==false; }
filterByBoolMask = List.FilterByBoolMask(list=python_script, mask=code_block)
ViewTemplates = Output(filterByBoolMask.in)
