# Dynamo custom node RIE_GetAllViews.dyf (Dynamo 2.3.0.5885)
# category: RIE.Views
# Retrieves all view elements that are not View Templates in the model.

get_all_views_python = Python()  # graph input
# ---------- get_all_views_python.python (46 lines) ----------
import clr
clr.AddReference('ProtoGeometry')
from Autodesk.DesignScript.Geometry import *

# Import DocumentManager and TransactionManager
clr.AddReference("RevitServices")
import RevitServices
from RevitServices.Persistence import DocumentManager
from RevitServices.Transactions import TransactionManager

# Import RevitAPI
clr.AddReference("RevitAPI")
import Autodesk
from Autodesk.Revit.DB import *

doc = DocumentManager.Instance.CurrentDBDocument
uiapp = DocumentManager.Instance.CurrentUIApplication
app = uiapp.Application

from System.Collections.Generic import *

# Import ToDSType(bool) extension method
clr.AddReference("RevitNodes")
import Revit
clr.ImportExtensions(Revit.Elements)

#The inputs to this node will be stored as a list in the IN variable.
dataEnteringNode = IN

#collect all views in the model
collector = FilteredElementCollector(doc)
views = collector.OfClass(View).ToElements()

viewlist = []

for i in views:
	if not i.IsTemplate:
		if i != None:
			viewlist.append(i)
		else:
			continue
	else:
		continue

#Assign your output to the OUT variable
OUT = viewlist
# ----------------------------------------
views = Output(get_all_views_python)
refresh = Input(refresh: var[]..[])
