# Dynamo custom node RIE_GetImportInstancesInView.dyf (Dynamo 2.3.0.5885)
# category: RIE.Views
# Gets Imported instances like CAD links in input view.

views = Input(views: var[]..[])
python_script = Python(IN[0]=views)
# ---------- python_script.python (37 lines) ----------
import clr

# Import DocumentManager and TransactionManager
clr.AddReference("RevitServices")
import RevitServices
from RevitServices.Persistence import DocumentManager

# Import RevitAPI
clr.AddReference("RevitAPI")
import Autodesk
from Autodesk.Revit.DB import *

# Import ToDSType(bool) extension method
clr.AddReference("RevitNodes")
import Revit
clr.ImportExtensions(Revit.Elements)

doc = DocumentManager.Instance.CurrentDBDocument
OUT = []

def tolist(obj):
	if isinstance(obj, list):
		return UnwrapElement(obj)
	else:
		return [UnwrapElement(obj)]

views = tolist(IN[0])

for view in views:
	collector = FilteredElementCollector(doc, view.Id).OfClass(ImportInstance)
	collector.ToElements()
	importinstance = []
	for item in collector:
		importinstance.append(item)
	OUT.append(importinstance)
if len(OUT) == 1:
	OUT = OUT[0]
# ----------------------------------------
ImportInstances = Output(python_script)
code_block = CodeBlock { "Name"; }
getParameterValueByName = Element.GetParameterValueByName(element=python_script, parameterName=code_block)
Names = Output(getParameterValueByName)
