# Dynamo custom node RIE_GetPanelFromPanelScheduleView.dyf (Dynamo 1.3.2.2480)
# category: RIE.Power
# Gets The panel corresponding to the input PanelScheduleView

PanelScheduleView = Input()
python_script = Python(IN[0]=PanelScheduleView)
# ---------- python_script.python (30 lines) ----------
import clr
clr.AddReference('RevitAPI')
from Autodesk.Revit.DB import *
clr.AddReference('RevitServices')
import RevitServices
from RevitServices.Persistence import DocumentManager
from RevitServices.Transactions import TransactionManager

# Import ToDSType(bool) extension method
clr.AddReference("RevitNodes")
import Revit
clr.ImportExtensions(Revit.Elements)

doc = DocumentManager.Instance.CurrentDBDocument
uiapp = DocumentManager.Instance.CurrentUIApplication
app = uiapp.Application
#The inputs to this node will be stored as a list in the IN variables.

OUT = []

def tolist(obj):
	if isinstance(obj, list):
		return UnwrapElement(obj)
	else:
		return UnwrapElement([obj])

panels = tolist(IN[0])

for panel in panels:
	OUT.append(doc.GetElement(panel.GetPanel()).ToDSType(True))
# ----------------------------------------
Panel = Output(python_script)
