# Dynamo custom node RIE_If.dyf (Dynamo 1.3.2.2480)
# category: RIE.List
# An If node that keeps list structure, empty lists and so forth.

Test = Input()
True_ = Input(True)
False_ = Input(False)
if_ = Python(IN[0]=Test, IN[1]=True_, IN[2]=False_)  # "RIE.If"
# ---------- if_.python (19 lines) ----------
import clr
clr.AddReference('ProtoGeometry')
from Autodesk.DesignScript.Geometry import *
#The inputs to this node will be stored as a list in the IN variables.

OUT = []

def tolist(obj):
	if hasattr(obj,"__iter__"):
		return obj
	else:
		return [obj]

if IN[0] == True:
	for x in tolist(IN[1]):
		OUT.append(x)
else:
	for x in tolist(IN[2]):
		OUT.append(x)
# ----------------------------------------
Result = Output(if_)
