# Dynamo custom node RIE_IndexOf.dyf (Dynamo 2.3.0.5885)
# category: RIE.List
# Returns a sublistlist with all indexes for each item.

list = Input(list: var[]..[])
Item = Input(Item: var[]..[])
python_script = Python(IN[0]=list, IN[1]=Item)
# ---------- python_script.python (27 lines) ----------
import clr
clr.AddReference('ProtoGeometry')
from Autodesk.DesignScript.Geometry import *
#The inputs to this node will be stored as a list in the IN variables.

OUT = []

def tolist(obj):
	if hasattr(obj, "__iter__"):
		return obj
	else:
		return [obj]
		
items = tolist(IN[0])
		
for i in tolist(IN[1]):
	item1 = i
	indices = []
	for j in range(0, len(items)):
		item2 = items[j]
		if item1 == item2:
			indices.append(j)
			
	OUT.append(indices)

if len(OUT) == 1:
	OUT = OUT[0]
# ----------------------------------------
Indices = Output(python_script)
