# Dynamo custom node RIE_LevelAtPoint.dyf (Dynamo 2.3.0.5885)
# category: RIE.Elements
# Input point, and retrieve level below where the point resides.

categories = Categories("OST_Levels")  # graph input
all_elements_of_category = ElementsOfCategory(Category=categories)
code_block = CodeBlock { "Elevation"; }
getParameterValueByName = Element.GetParameterValueByName(element=all_elements_of_category, parameterName=code_block)
sortByKey = List.SortByKey(list=all_elements_of_category, keys=getParameterValueByName)
points = Input(points: var[]..[])
python_script = Python(IN[0]=points)
# ---------- python_script.python (24 lines) ----------
import clr
clr.AddReference('ProtoGeometry')
from Autodesk.DesignScript.Geometry import *
#The inputs to this node will be stored as a list in the IN variables.

X = list()
Y = list()
Z = list()

def tolist(input):
	if isinstance(input, list):
		return input
	else:
		return [input]
		
def splitPt(pt):
	return [pt.X,pt.Y,pt.Z]

for pt in tolist(IN[0]):
	X.append(splitPt(pt)[0])
	Y.append(splitPt(pt)[1])
	Z.append(splitPt(pt)[2])
		
OUT = X, Y, Z
# ----------------------------------------
code_block_2 = CodeBlock(a=python_script) { a[0]; a[1]; a[2]; }
lt = code_block_2.out2 < sortByKey.sorted_keys  # lacing=CrossProduct
boolean = BoolSelector(true)  # graph input
indexOf = List.IndexOf(list=lt@L2, element=boolean)
code_block_3 = CodeBlock(a=indexOf) { a-1; }
getItemAtIndex = List.GetItemAtIndex(list=sortByKey.sorted_list, index=code_block_3)
maximumItem = List.MaximumItem(list=sortByKey.sorted_keys)
indexOf_2 = List.IndexOf(list=sortByKey.sorted_keys, element=maximumItem)
getItemAtIndex_2 = List.GetItemAtIndex(list=sortByKey.sorted_list, index=indexOf_2)
python_script_2 = Python(IN[0]=getItemAtIndex, IN[1]=getItemAtIndex_2)
# ---------- python_script_2.python (7 lines) ----------
OUT = []

for i in IN[0]:
	if i == None:
		OUT.append(IN[1])
	else:
		OUT.append(i)
# ----------------------------------------
Levels = Output(python_script_2)
