# Dynamo custom node RIE_LineElement_Filter_Only_Inside.dyf (Dynamo 2.3.0.5885)
# category: RIE.Elements
# Works together with bimorph elementsintersect node for line elements. Filters on line elements that are only the same, or part of eachother with almost equal line direction

mainElements = Input(mainElements: var[]..[])
refElements = Input(refElements: var[]..[])
tolerance = Input(tolerance: var[]..[])
python_script = Python(IN[0]=mainElements, IN[1]=refElements, IN[2]=tolerance)
# ---------- python_script.python (59 lines) ----------
# @ Copyright - Designed by André Abotnes andre.abotnes@norconsult.com
import sys
import clr
# Import ToDSType(bool) extension method
clr.AddReference('RevitNodes')
import Revit
clr.ImportExtensions(Revit.GeometryConversion)
clr.ImportExtensions(Revit.Elements)

#### CREATE DEFINITIONS FOR REPEATED PROCESSES

def tolist(obj): # Make sure we are working with lists
	if isinstance(obj, list):
		return UnwrapElement(obj)
	else:
		return [UnwrapElement(obj)]
		
def dst(pt1, pt2): # Return distance between two points
	return pt1.DistanceTo(pt2)*ftratio

def project(l,pt): # Projects a point onto a curve.
	return l.Project(pt).XYZPoint

#### DEFINE VARIABLES AND CONSTANTS

OUT = []
ftratio = 304.8 # ft to mm convertion
tol = IN[2] # tolerance
main = tolist(IN[0])
ref = tolist(IN[1])
mainlines = [m.Location.Curve.ToProtoType() for m in main] # Get Line Geometry From main walls
reflines = []
# Get Line Geometry From Ref Walls
for reflinelist in ref:
	reflines.append([r.Location.Curve.ToProtoType() for r in reflinelist])



#### MAIN CODE
i=0
for ml, rlist in zip(mainlines, reflines):
	if ml.Length > 1:
		rmlpts = [ml.StartPoint.ToRevitType(), ml.EndPoint.ToRevitType()]
		rml = ml.ToRevitType()
		iteratorlist = []
		for rl in rlist:
			if rl.Length > 1:
				rrlpts = [rl.StartPoint.ToRevitType(), rl.EndPoint.ToRevitType()]
				rrl = rl.ToRevitType()
				if dst(project(rml,rrlpts[0]),rrlpts[0]) < tol \
				and dst(project(rml,rrlpts[1]),rrlpts[1]) < tol \
				and (rl.Direction.ToXyz().AngleTo(ml.Direction.ToXyz()) % 3.14 < 0.02 or (rl.Direction.ToXyz().AngleTo(ml.Direction.ToXyz()) % 3.14 > 3.12)):
					iteratorlist.append(ref[i][rlist.IndexOf(rl)])
				elif dst(project(rrl,rmlpts[0]),rmlpts[0]) < tol \
				and dst(project(rrl,rmlpts[1]),rmlpts[1]) < tol \
				and (rl.Direction.ToXyz().AngleTo(ml.Direction.ToXyz()) % 3.14 < 0.02 or (rl.Direction.ToXyz().AngleTo(ml.Direction.ToXyz()) % 3.14 > 3.12)):
					iteratorlist.append(ref[i][rlist.IndexOf(rl)])
		OUT.append(iteratorlist)
	i+=1
# ----------------------------------------
isEmpty = List.IsEmpty(list=python_script@L2)
filterByBoolMask = List.FilterByBoolMask(list=mainElements, mask=isEmpty)
mainElements_2 = Output(filterByBoolMask.out)  # "mainElements[]"
filterByBoolMask_2 = List.FilterByBoolMask(list=python_script, mask=isEmpty)
refElements_2 = Output(filterByBoolMask_2.out)  # "refElements[][]"
orphanMainElements = Output(filterByBoolMask.in)  # "orphanMainElements[]"
