# Dynamo custom node RIE_MoveCircuit.dyf (Dynamo 1.3.2.2480)
# category: RIE.Power
# Moves Circuitnumber To input circuit number row. New Circuit number row has to be unoccupied.

PanelScheduleView = Input()
FromRow = Input()
ToRow = Input()
code_block = CodeBlock { 1; }
python_script = Python(IN[0]=PanelScheduleView, IN[1]=FromRow, IN[2]=ToRow, IN[3]=code_block)
# ---------- python_script.python (32 lines) ----------
import clr
clr.AddReference('RevitAPI')
from Autodesk.Revit.DB import *
clr.AddReference('RevitServices')
import RevitServices
from RevitServices.Persistence import DocumentManager
from RevitServices.Transactions import TransactionManager

doc = DocumentManager.Instance.CurrentDBDocument
uiapp = DocumentManager.Instance.CurrentUIApplication
app = uiapp.Application
#The inputs to this node will be stored as a list in the IN variables.

def tolist(obj):
	if isinstance(obj, list):
		return obj
	else:
		return [obj]

PS = UnwrapElement(IN[0])
nMovingRow = tolist(IN[1])
nToRow = tolist(IN[2])
Col = IN[3]

TransactionManager.Instance.EnsureInTransaction(doc)

for n in range(0, len(nMovingRow)):
	PS.MoveSlotTo(nMovingRow[n]+1,Col,nToRow[n]+1,Col)

TransactionManager.Instance.TransactionTaskDone()
		
OUT = PS
# ----------------------------------------
PanelScheduleView_2 = Output(python_script)  # "PanelScheduleView"
