# Dynamo custom node RIE_Orient3DViewToSelectedFace.dyf (Dynamo 1.3.2.2480)
# category: RIE.Views
# Orients the active 3D view to the selected face. First select the element or link you want to select a reference face from, then select the face.

python_script = Python()  # unwired: IN[0]
# ---------- python_script.python (54 lines) ----------
# Copyright(c) 2017, Dimitar Venkov
# @5devene, dimitar.ven@gmail.com
# www.badmonkeys.net

import clr

clr.AddReference("RevitAPIUI")
from  Autodesk.Revit.UI import *

clr.AddReference("RevitServices")
import RevitServices
from RevitServices.Persistence import DocumentManager
doc = DocumentManager.Instance.CurrentDBDocument
uidoc=DocumentManager.Instance.CurrentUIApplication.ActiveUIDocument

clr.AddReference("RevitNodes")
import Revit
clr.ImportExtensions(Revit.Elements)
clr.ImportExtensions(Revit.GeometryConversion)

clr.AddReference("RevitAPI")
from Autodesk.Revit.DB import RevitLinkInstance, FamilyInstance

def output1(x):
	if len(x) == 1: return x[0]
	else : return x

sel1 = uidoc.Selection
ot1 = Selection.ObjectType.Element
ot2 = Selection.ObjectType.PointOnElement
li_ref = sel1.PickObject(ot1, "Select a link instance first.")
link1 = doc.GetElement(li_ref.ElementId)
if isinstance(link1, RevitLinkInstance):
	tf1 = link1.GetTotalTransform()
	face_ref = sel1.PickObject(ot2, "Pick a face.")
	linkDoc = link1.GetLinkDocument()
	el1 = linkDoc.GetElement(face_ref.LinkedElementId)
	face_ref2 = face_ref.CreateReferenceInLink()
	sf0 = el1.GetGeometryObjectFromReference(face_ref2)
	if isinstance(el1, FamilyInstance):
		tf1 *= el1.GetTotalTransform()
	sf1 = sf0.Convert(face_ref2, tf1.ToCoordinateSystem(True) )
	for s in sf1:	
		s.Tags.AddTag("RevitFaceReference", face_ref)
	OUT = output1(sf1), face_ref.GlobalPoint.ToPoint(True), link1
else:
	tf1 = link1.GetTotalTransform()
	face_ref = sel1.PickObject(ot2, "Pick a face.")
	el1 = link1
	if isinstance(el1, FamilyInstance):
		tf1 *= el1.GetTotalTransform()
	sf0 = link1.GetGeometryObjectFromReference(face_ref)
	sf1 = sf0.Convert(face_ref, tf1.ToCoordinateSystem(True))
	OUT = output1(sf1), face_ref.GlobalPoint.ToPoint(True), link1
# ----------------------------------------
code_block = CodeBlock(a=python_script) { a[0]; a[1]; a[2]; }
normalAtPoint = Surface.NormalAtPoint(surface=code_block.out0, point=code_block.out1)
ZAxis = Vector.ZAxis()
rotationAngle = Python(IN[0]=code_block.out2)  # "Element.RotationAngle"
# ---------- rotationAngle.python (32 lines) ----------
#This script looks for the rotation angle of Revit elements if available.
#If location is a LocationPoint then the Rotation value is available.
#In case of a slanted column, the Location is a LocationCurve, which doesn't have a rotation value.
#Authored by Dieter Vermeulen, Autodesk, 2015
#http://revitbeyondbim.wordpress.com

import clr
import math

clr.AddReference('ProtoGeometry')
from Autodesk.DesignScript.Geometry import *

#Import RevitAPI
clr.AddReference('RevitAPI')
import Autodesk
#The inputs to this node will be stored as a list in the IN variables.
resRotation = []
strCol= IN[0]

#make unwrapped list of elements
element = UnwrapElement(strCol)
	
#get location and then rotation of element, if not not existing, then set rotation to null.
try:
	loc=element.Location
	resRotation.append(math.degrees(loc.Rotation)-180)
except:
	resRotation.append(-180)
	

#Assign your output to the OUT variable.
OUT=resRotation
# ----------------------------------------
rotate = Vector.Rotate(normalAtPoint, ZAxis, rotationAngle)
reverse = Vector.Reverse(rotate)
python_script_2 = Python(IN[0]=reverse)
# ---------- python_script_2.python (40 lines) ----------
import clr
clr.AddReference('ProtoGeometry')
from Autodesk.DesignScript.Geometry import *

# Import ToDSType(bool) extension method
clr.AddReference("RevitNodes")
import Revit
clr.ImportExtensions(Revit.Elements)
clr.ImportExtensions(Revit.GeometryConversion)

# Import DocumentManager and TransactionManager
clr.AddReference("RevitServices")
import RevitServices
from RevitServices.Persistence import DocumentManager
from RevitServices.Transactions import TransactionManager

from System.Collections.Generic import *

# Import RevitAPI
clr.AddReference("RevitAPI")
import Autodesk
from Autodesk.Revit.DB import ReferencePointArray

input = UnwrapElement(IN[0])
vector = input[0].ToRevitType()


doc = DocumentManager.Instance.CurrentDBDocument
uiapp = DocumentManager.Instance.CurrentUIApplication
app = uiapp.Application
ThisView = doc.ActiveView

TransactionManager.Instance.EnsureInTransaction(doc)
#apply lineweight override to elements in an input list

ThisView.OrientTo(vector)

# "End" the transaction
TransactionManager.Instance.TransactionTaskDone()
OUT = doc.ActiveView
# ----------------------------------------
ActiveView = Output(python_script_2)
