# Dynamo custom node RIE_PlaceViewOnSheet.dyf (Dynamo 2.3.0.5885)
# category: RIE.Views
# Places Views, Schedules or Legends into sheets.

view_Schedule_Legend = Input(view_Schedule_Legend: var[]..[])
sheet = Input(sheet: var[]..[])
point = Input(point: var[]..[])
refresh = Input(refresh: var[]..[])
place_view_legend_schedule_on = Python(IN[0]=view_Schedule_Legend, IN[1]=sheet, IN[2]=point, IN[3]=refresh)  # "Place View/Legend/Schedule On Sheet(s) (py)"
# ---------- place_view_legend_schedule_on.python (50 lines) ----------
import clr

clr.AddReference("RevitServices")
import RevitServices 
from RevitServices.Persistence import DocumentManager
from RevitServices.Transactions import TransactionManager
doc = DocumentManager.Instance.CurrentDBDocument
uidoc = DocumentManager.Instance.CurrentUIDocument
clr.AddReference("RevitNodes")
import Revit
clr.ImportExtensions(Revit.Elements)
clr.ImportExtensions(Revit.GeometryConversion)
clr.AddReference("RevitAPI")
from Autodesk.Revit.DB import *
from Autodesk.Revit.DB.Electrical import PanelScheduleSheetInstance as pssi
clr.AddReference("RevitAPIUI")
from Autodesk.Revit.UI import *

def tolist(obj1):
	if hasattr(obj1,"__iter__"): return obj1
	else: return [obj1]

views = tolist(IN[0])
sheets = tolist(IN[1])
locs = tolist(IN[2])
viewports = []
failed = []

i = 0;
if len(views) == len(locs):
	for v in views:
		loc = XYZ(locs[i].X, locs[i].Y, locs[i].Z)
		view = UnwrapElement(v)
		for vs in sheets:
			sheet = UnwrapElement(vs)
			canAddToSht = True;							
			if canAddToSht:				
				try:
						TransactionManager.Instance.EnsureInTransaction(doc)	
						viewport = Viewport.Create(doc, sheet.Id, view.Id, loc)	
						TransactionManager.Instance.TransactionTaskDone()
						viewports.Add([viewport,sheet])
				except Exception, e:
					failed.Add([str(e),sheet])
			else:
				failed.Add(["Failed",sheet])
		i = i+1
	OUT = [viewports, failed]
else:
	OUT = "Error! The number of views you want to place must match the number of Location Points"
# ----------------------------------------
code_block = CodeBlock(a=place_view_legend_schedule_on) { a[0]; a[1]; }
Placed = Output(code_block.out0)
Failed = Output(code_block.out1)
