# Dynamo custom node RIE_PowerElements.dyf (Dynamo 2.3.0.5885)
# category: RIE.Power
# Powers list of elements

Elems = Input(Elems: var[]..[])
powerType = Input(powerType: var = null)
python_script = Python(IN[0]=powerType)
# ---------- python_script.python (28 lines) ----------
import clr
clr.AddReference('ProtoGeometry')
from Autodesk.DesignScript.Geometry import *

clr.AddReference('RevitServices')
import RevitServices
from RevitServices.Persistence import DocumentManager
from RevitServices.Transactions import TransactionManager
from System.Collections.Generic import *

clr.AddReference('RevitNodes')
import Revit
clr.ImportExtensions(Revit.Elements)

clr.AddReference('RevitAPI')
import Autodesk
from Autodesk.Revit.DB import *
from Autodesk.Revit.DB.Electrical import *
from Autodesk.Revit.DB import MEPSystem

clr.AddReference('DSCoreNodes')
import DSCore
from DSCore.List import *

if IN[0] == None:
	OUT = ElectricalSystemType.PowerCircuit
else:
	OUT = IN[0]
# ----------------------------------------
python_script_2 = Python(IN[0]=Elems, IN[1]=python_script)
# ---------- python_script_2.python (63 lines) ----------
import clr
clr.AddReference('ProtoGeometry')
from Autodesk.DesignScript.Geometry import *

clr.AddReference('RevitServices')
import RevitServices
from RevitServices.Persistence import DocumentManager
from RevitServices.Transactions import TransactionManager
from System.Collections.Generic import *

clr.AddReference('RevitNodes')
import Revit
clr.ImportExtensions(Revit.Elements)

clr.AddReference('RevitAPI')
import Autodesk
from Autodesk.Revit.DB import *
from Autodesk.Revit.DB.Electrical import *
from Autodesk.Revit.DB import MEPSystem

clr.AddReference('DSCoreNodes')
import DSCore
from DSCore.List import *

import sys
pyt_path = r'C:\Program Files (x86)\IronPython 2.7\Lib'
sys.path.append(pyt_path)

# Import List ( ICollection(ElementId) = List[ElementId]() )
clr.AddReference("System")
from System.Collections.Generic import List 

def tolist(obj):
	if isinstance(obj, list):
		return UnwrapElement(obj)
	else:
		return [UnwrapElement(obj)]

#The inputs to this node will be stored as a list in the IN variables.
input = tolist(IN[0])

electComponents = List[ElementId]()


for i in input:
	electComponents.Add(i.Id)


doc = DocumentManager.Instance.CurrentDBDocument
uiapp = DocumentManager.Instance.CurrentUIApplication
app = uiapp.Application
uidoc = DocumentManager.Instance.CurrentUIApplication.ActiveUIDocument

TransactionManager.Instance.EnsureInTransaction(doc)

newcircuit = ElectricalSystem.Create(doc, electComponents, IN[1])


OUT = []
OUT.append(newcircuit)


TransactionManager.Instance.TransactionTaskDone()
# ----------------------------------------
Circuit = Output(python_script_2)
