# Dynamo custom node RIE_ReplaceNullsWith.dyf (Dynamo 2.3.0.5885)
# category: RIE.List
# Replaces nulls in input list with input replacement object.

list = Input(list: var[]..[])
ReplaceWith = Input(ReplaceWith: var[]..[])
python_script = Python(IN[0]=list, IN[1]=ReplaceWith)
# ---------- python_script.python (16 lines) ----------
OUT = []

def tolist(obj):
	if isinstance(obj, list):
		return obj
	else:
		return [obj]
		
for i in tolist(IN[0]):
	if i == None:
		try:
			OUT.append(tolist(IN[1])[0])
		except:
			OUT.append(tolist(IN[1]))
	else:
		OUT.append(i)
# ----------------------------------------
List = Output(python_script)
