# Dynamo custom node RIE_SelectLinkedElement.dyf (Dynamo 2.3.0.5885)
# category: RIE.Elements
# Prompts you to select link, then select linked element. Returns Link element instnace, Link instance and Link Transform.
# packages: RIE 0.7.1

refresh = Input(refresh: var[]..[])
python_script = Python(IN[0]=refresh)
# ---------- python_script.python (36 lines) ----------
# Copyright(c) 2017, Dimitar Venkov
# @5devene, dimitar.ven@gmail.com
# www.badmonkeys.net

import clr

clr.AddReference("RevitAPIUI")
from Autodesk.Revit.UI import *

clr.AddReference("RevitAPI")
from Autodesk.Revit.DB import RevitLinkInstance, Transform 

clr.AddReference("RevitServices")
import RevitServices
from RevitServices.Persistence import DocumentManager
doc = DocumentManager.Instance.CurrentDBDocument
uidoc = DocumentManager.Instance.CurrentUIApplication.ActiveUIDocument

clr.AddReference("RevitNodes")
import Revit
clr.ImportExtensions(Revit.Elements)
clr.ImportExtensions(Revit.GeometryConversion)

sel1 = uidoc.Selection
ot1 = Selection.ObjectType.Element
ot2 = Selection.ObjectType.LinkedElement
li_ref = sel1.PickObject(ot1, "Select a link instance first.")
link1 = doc.GetElement(li_ref.ElementId)
if isinstance(link1, RevitLinkInstance):
	el_ref = sel1.PickObject(ot2, "Pick a linked element.")
	LinkDoc = link1.GetLinkDocument()
	tf1 = link1.GetTotalTransform().ToCoordinateSystem(True)
	elem = LinkDoc.GetElement(el_ref.LinkedElementId).ToDSType(True)
	OUT = elem, link1, tf1
else:
	OUT = link1, Transform.Identity.ToCoordinateSystem(True)
# ----------------------------------------
code_block = CodeBlock(r=python_script) { r[0]; r[1]; r[2]; }
Element = Output(code_block.out0)
LinkInstance = Output(code_block.out1)
linkedElementCategory = Custom[RIE.LinkedElementCategory](linkElement=code_block.out0)  # package RIE; Returns Category of Linked Element
code_block_2 = CodeBlock(a=linkedElementCategory) { a[0]; }
Category = Output(code_block_2)
Transform = Output(code_block.out2)
