# Dynamo custom node RIE_SpaceTag.Space.dyf (Dynamo 2.0.2.6826)
# category: RIE.Elements
# Retrieves the Space which the Space Tag represents. Also works with Room Tags, retrieving corresponding rooms.
# Tag : RIE_RoomTag.Room

space_tag = Input(space tag: var[]..[])
python_script = Python(IN[0]=space_tag)
# ---------- python_script.python (60 lines) ----------
# @ Copyright - Designed by André Abotnes andre.abotnes@norconsult.com
import sys
#pyt_path = r"C:\Program Files (x86)\IronPython 2.7\DLLs"
#sys.path.append(pyt_path)
import clr

#clr.AddReference('IronPython.SQLite.dll')
pyt_path = r"C:\Program Files (x86)\IronPython 2.7\Lib"
sys.path.append(pyt_path)
#import sqlite3

# Import ToDSType(bool) extension method
clr.AddReference('RevitNodes')
import Revit
clr.ImportExtensions(Revit.GeometryConversion)
clr.ImportExtensions(Revit.Elements)

# Import DocumentManager and TransactionManager
clr.AddReference('RevitServices')
import RevitServices
from RevitServices.Persistence import DocumentManager
from RevitServices.Transactions import TransactionManager

doc = DocumentManager.Instance.CurrentDBDocument
uidoc = DocumentManager.Instance.CurrentUIApplication.ActiveUIDocument
app = DocumentManager.Instance.CurrentUIApplication.Application

# Import List ( ICollection(ElementId) = List[ElementId]() )
clr.AddReference('System')
from System.Collections.Generic import List

# Import Revit API + APIUI
clr.AddReference('RevitAPI')
from Autodesk.Revit.DB import *
from Autodesk.Revit.DB.Electrical import *

clr.AddReference('RevitAPIUI')
from Autodesk.Revit.UI import *

OUT = []

def tolist(obj):
	if isinstance(obj, list):
		return UnwrapElement(obj)
	else:
		return [UnwrapElement(obj)]

tags = tolist(IN[0])

for tag in tags:
	if "SpaceTag" in str(tag):
		OUT.append(tag.Space)
	if "RoomTag" in str(tag):
		OUT.append(tag.Room)

# Start Transaction
# TransactionManager.Instance.EnsureInTransaction(doc)

# End Transaction
# TransactionManager.Instance.TransactionTaskDone()
# ----------------------------------------
space = Output(python_script)
