# Dynamo custom node RIE_Wall_GetDoorsAndWindows.dyf (Dynamo 2.3.0.5885)
# category: RIE.Elements
# Retrieves Doors and Windows hosted by input wall element
# packages: RIE 2020.8.12

walls = Input(walls: var[]..[])
python_script = Python(IN[0]=walls)
# ---------- python_script.python (69 lines) ----------
# @ Copyright - Designed by André Abotnes andre.abotnes@norconsult.com
import sys
#pyt_path = r"C:\Program Files (x86)\IronPython 2.7\DLLs"
#sys.path.append(pyt_path)
import clr

#clr.AddReference('IronPython.SQLite.dll')
pyt_path = r"C:\Program Files (x86)\IronPython 2.7\Lib"
sys.path.append(pyt_path)
#import sqlite3

# Import ToDSType(bool) extension method
clr.AddReference('RevitNodes')
import Revit
clr.ImportExtensions(Revit.GeometryConversion)
clr.ImportExtensions(Revit.Elements)

# Import DesignScript.Geometry
clr.AddReference('ProtoGeometry')
from Autodesk.DesignScript.Geometry import *

# Import DocumentManager and TransactionManager
clr.AddReference('RevitServices')
import RevitServices
from RevitServices.Persistence import DocumentManager
from RevitServices.Transactions import TransactionManager

doc = DocumentManager.Instance.CurrentDBDocument
uidoc = DocumentManager.Instance.CurrentUIApplication.ActiveUIDocument
app = DocumentManager.Instance.CurrentUIApplication.Application

# Import List ( ICollection(ElementId) = List[ElementId]() )
clr.AddReference('System')
from System.Collections.Generic import List

# Import Revit API + APIUI
clr.AddReference('RevitAPI')
from Autodesk.Revit.DB import *
from Autodesk.Revit.DB.Electrical import *

clr.AddReference('RevitAPIUI')
from Autodesk.Revit.UI import *

OUT = []

def tolist(obj):
	if isinstance(obj, list):
		return UnwrapElement(obj)
	else:
		return [UnwrapElement(obj)]

input = tolist(IN[0])

doorCategoryfilter = ElementCategoryFilter(BuiltInCategory.OST_Doors)
windowCategoryfilter = ElementCategoryFilter(BuiltInCategory.OST_Windows)

for elem in input:
	doorelemids = elem.GetDependentElements(doorCategoryfilter)
	windowelemids = elem.GetDependentElements(windowCategoryfilter)
	
	doors = []
	windows = []

	for id in doorelemids:
		doors.append(doc.GetElement(id))
	for id in windowelemids:
		windows.append(doc.GetElement(id))
		
	OUT.append([doors, windows])
# ----------------------------------------
transpose = List.Transpose(lists=python_script)
code_block = CodeBlock { 0; 1; }
getItemAtIndex = List.GetItemAtIndex(list=transpose, index=code_block.out0)
empty = List.Empty()
RIE_ReplaceNullsWith = Custom[RIE_ReplaceNullsWith](list=getItemAtIndex, ReplaceWith=empty)  # package RIE; Replaces nulls in input list with input replacement object.
doors = Output(RIE_ReplaceNullsWith)
getItemAtIndex_2 = List.GetItemAtIndex(list=transpose, index=code_block.out1)
RIE_ReplaceNullsWith_2 = Custom[RIE_ReplaceNullsWith](list=getItemAtIndex_2, ReplaceWith=empty)
windows = Output(RIE_ReplaceNullsWith_2)
