# Dynamo graph Rhynamo_Workflow01_ExampleImport.dyn (Dynamo 0.7.5.3566)

file_path = Filename("C:\CASE\SAMPLES\SurfaceRebuildTests.3dm")
fromPath = FileObject(file_path)  # "File.FromPath"
# note: Get 3DM File and Attributes
get_RhinoFile = Interoperability.ReadRhino.OpenRhino3dmModel.Get_RhinoFile(fromPath)
# note: Get Rhino document object lists
get_DocumentObjects = Interoperability.ReadRhino.RhinoObject.Get_DocumentObjects(get_RhinoFile)
# note: Convert Geometry objects and get attributes
rhino_NurbsSurfaceToDS = Interoperability.ReadRhino.RhinoTranslationToDS.Rhino_NurbsSurfaceToDS(get_DocumentObjects.out0)
getItemAtIndex = List.GetItemAtIndex(get_DocumentObjects.out2, rhino_NurbsSurfaceToDS.out2)
# note: Get layers and layer attributes
get_LayerAttributes = Interoperability.ReadRhino.RhinoObjectAttributes.Get_LayerAttributes(getItemAtIndex)
file_path_2 = Filename("C:\CASE\SAMPLES\SampleWritePoints.3dm")
boolean = BoolSelector(true)
number = DoubleInput(0)
number_2 = DoubleInput(10)
number_3 = DoubleInput(2)
number_sequence = NumberSeq(number, number_2, number_3, lacing=Longest)
byCoordinates = Point.ByCoordinates(number_sequence, number_sequence, lacing=CrossProduct)
DS_PointsToRhino = Interoperability.WriteRhino.CreateRhinoGeometry.DS_PointsToRhino(byCoordinates)
string = StringInput("DynPoints")
number_4 = DoubleInput(100)
create_RhinoColor = Interoperability.WriteRhino.CreateRhinoObjects.Create_RhinoColor(number_4, number_4, number_4)
create_RhinoLayer = Interoperability.WriteRhino.CreateRhinoObjects.Create_RhinoLayer(string, create_RhinoColor)
create_RhinoObject = Interoperability.WriteRhino.CreateRhinoObjects.Create_RhinoObject(DS_PointsToRhino, string, create_RhinoColor, create_RhinoLayer)
flatten = Flatten(create_RhinoObject)
save_Rhino3dmModel = Interoperability.WriteRhino.SaveRhino3dmModel.Save_Rhino3dmModel(file_path_2, boolean, flatten)
watch = Watch(rhino_NurbsSurfaceToDS.out0)
