# Dynamo graph Rhynamo_Workflow02_ExampleExport.dyn (Dynamo 0.7.5.3566)

# note: The file path to save to...
file_path = Filename("C:\CASE\SAMPLES\LayerExport\PointTest-2.3dm")
# note: Set to 'True' to write the file
boolean = BoolSelector(false)
number = DoubleInput(0)
number_2 = DoubleInput(20)
number_3 = DoubleInput(5)
number_sequence = NumberSeq(number, number_2, number_3, lacing=Longest)
# note: Sample Dynamo Geometry
byCoordinates = Point.ByCoordinates(number_sequence, number_sequence, lacing=CrossProduct)
flatten = Flatten(byCoordinates)
# note: Convert Dynamo Type to Rhino Geometry
DS_PointsToRhino = Interoperability.WriteRhino.CreateRhinoGeometry.DS_PointsToRhino(flatten)
string = StringInput("Dyn")
number_4 = DoubleInput(100)
# note: Create a System Color
create_RhinoColor = Interoperability.WriteRhino.CreateRhinoObjects.Create_RhinoColor(number_4, number_4, number_4)
# note: Create a Rhino Layer
create_RhinoLayer = Interoperability.WriteRhino.CreateRhinoObjects.Create_RhinoLayer(string, create_RhinoColor)
# note: Create a Rhino object with attributes
create_RhinoObject = Interoperability.WriteRhino.CreateRhinoObjects.Create_RhinoObject(DS_PointsToRhino, string, create_RhinoColor, create_RhinoLayer)
# note: Save a Rhino File
save_Rhino3dmModel = Interoperability.WriteRhino.SaveRhino3dmModel.Save_Rhino3dmModel(file_path, boolean, create_RhinoObject)
