# Dynamo custom node GetBottomCurve.dyf (Dynamo 0.7.4.3245)
# category: Geometry.Geometry.Actions
# Gets the curve of a geometry object from the bottom most plane

geom = Input()
XY = Plane.XY()
byGeometry = BoundingBox.ByGeometry(geom)
minPoint = BoundingBox.MinPoint(byGeometry)
Z = Point.Z(minPoint)
offset = Plane.Offset(XY, Z)
intersect = Geometry.Intersect(geom, offset)
Curve = Output(intersect)
