# Dynamo graph Room to Floor.dyn (Dynamo 0.7.4.3245)

join = List.Join()
categories = Categories("Rooms")
all_elements_of_category = ElementsOfCategory(categories)
parameter_to_copy = CodeBlock { "Number"; }
getParameterValueByName = Element.GetParameterValueByName(all_elements_of_category, parameter_to_copy)
join_2 = List.Join()
geometry = Element.Geometry(all_elements_of_category)
getBottomCurve = Custom[GetBottomCurve]()  # Gets the curve of a geometry object from the bottom most plane
map = List.Map(geometry, getBottomCurve)
boundingBox = Geometry.BoundingBox(map)
number = DoubleInput(1.52)
find_midpoint_at_height = Custom[Find Midpoint at height](boundingBox=boundingBox, Z_Offset=number)  # Returns a point that is the midpoint of the x and y bounding box with an optional z offset
number_2 = DoubleInput(1)
flatten = List.Flatten(find_midpoint_at_height, number_2)
perimeterCurves = Surface.PerimeterCurves(map)
startPoint = Curve.StartPoint(perimeterCurves)
number_3 = DoubleInput(2)
flatten_2 = List.Flatten(startPoint, number_3)
combine = List.Combine(join_2, flatten, flatten_2)
create = List.Create()
map_2 = List.Map(combine, create)
combine_2 = List.Combine(join, getParameterValueByName, map_2)
code_block = CodeBlock { 0; }
# note: Adaptive Families - Lowest to Highest in number of points. (Must have family parameter called "Adaptive Points")
smallest_family = FamilyTypes("Adaptive Family - 4 Point:Adaptive Family - 4 Point")
code_block_2 = CodeBlock { "Adaptive Points"; }
getParameterValueByName_2 = Element.GetParameterValueByName(smallest_family, code_block_2)
python_script = Python(IN[0]=combine_2, IN[1]=code_block, IN[2]=getParameterValueByName_2)
# ---------- python_script.python (15 lines) ----------
import clr
clr.AddReference('ProtoGeometry')
from Autodesk.DesignScript.Geometry import *
#The inputs to this node will be stored as a list in the IN variable.
initialList = IN[0]
smallNum = IN[1]
largeNum = IN[2]

OUT = []

for i in xrange(0,len(initialList)):
	if not initialList[i][1]:
		initialList[i][1]
	elif smallNum < len(initialList[i][1]) <= largeNum:
		OUT.Add(initialList[i])
# ----------------------------------------
code_block_3 = CodeBlock { 1; }
getItemAtIndex = List.GetItemAtIndex(arg1=code_block_3)
map_3 = List.Map(python_script, getItemAtIndex)
fill_list = Custom[Fill List](Size=getParameterValueByName_2)  # Create of list of size 'x' takes list and repeats last value until it becomes the right size.
map_4 = List.Map(map_3, fill_list)
byPoints = AdaptiveComponent.ByPoints(map_4, smallest_family)
copied_to = CodeBlock { "Room Tag"; }
code_block_4 = CodeBlock { 0; }
getItemAtIndex_2 = List.GetItemAtIndex(arg1=code_block_4)
map_5 = List.Map(python_script, getItemAtIndex_2)
setParameterByName = Element.SetParameterByName(byPoints, copied_to, map_5)
medium_family = FamilyTypes("Adaptive Family - 20 Point:Adaptive Family - 20 Point")
getParameterValueByName_3 = Element.GetParameterValueByName(medium_family, code_block_2)
python_script_2 = Python(IN[0]=combine_2, IN[1]=getParameterValueByName_2, IN[2]=getParameterValueByName_3)  # same code as python_script
getItemAtIndex_3 = List.GetItemAtIndex(arg1=code_block_3)
map_6 = List.Map(python_script_2, getItemAtIndex_3)
fill_list_2 = Custom[Fill List](Size=getParameterValueByName_3)
map_7 = List.Map(map_6, fill_list_2)
byPoints_2 = AdaptiveComponent.ByPoints(map_7, medium_family)
getItemAtIndex_4 = List.GetItemAtIndex(arg1=code_block_4)
map_8 = List.Map(python_script_2, getItemAtIndex_4)
setParameterByName_2 = Element.SetParameterByName(byPoints_2, copied_to, map_8)
largest_family = FamilyTypes("Adaptive Family - 100 Point:Adaptive Family - 100 Point")
getParameterValueByName_4 = Element.GetParameterValueByName(largest_family, code_block_2)
python_script_3 = Python(IN[0]=combine_2, IN[1]=getParameterValueByName_3, IN[2]=getParameterValueByName_4)  # same code as python_script
getItemAtIndex_5 = List.GetItemAtIndex(arg1=code_block_3)
map_9 = List.Map(python_script_3, getItemAtIndex_5)
fill_list_3 = Custom[Fill List](Size=getParameterValueByName_4)
map_10 = List.Map(map_9, fill_list_3)
byPoints_3 = AdaptiveComponent.ByPoints(map_10, largest_family)
getItemAtIndex_6 = List.GetItemAtIndex(arg1=code_block_4)
map_11 = List.Map(python_script_3, getItemAtIndex_6)
setParameterByName_3 = Element.SetParameterByName(byPoints_3, copied_to, map_11)
