# Dynamo custom node __Audit DYN File.dyf "❄_Audit DYN File" (Dynamo 1.3.3.4111)
# category: Sastrugi.Management
# (Sastrugi_Management) This node audits a .DYN file to extract File Information, Total Connectors, Unique Node Information, Node Type Information and Total Nodes. Options included for creating CSV report and Audited DYN containing this information in original DYN's folder.

FilePath = Input()

# group: Main DYN Input
fromPath = FileObject(FilePath)  # "File.FromPath"
readText = File.ReadText(fromPath)
string = StringInput("\"")
split = String.Split(readText, string)

# group: File Name and Size - Credit @Dimitar Venkov
string_from_object = FromObject(fromPath)
string_2 = StringInput("\")
split_2 = String.Split(string_from_object, string_2)
lastItem = List.LastItem(split_2)
code_block = CodeBlock { false; }
python_script = Python(IN[0]=string_from_object, IN[1]=code_block)
# ---------- python_script.python (21 lines) ----------
from System.IO import FileInfo

def tolist(x):
	if hasattr(x,'__iter__'): return x
	else : return [x]

def output(x):
	if len(x) == 1: return x[0]
	else : return x

paths = tolist(IN[0])
mb = 1048576.0
kb = 1024.0
def getSize(p, mb=mb, kb=kb, kbOnly = IN[1]):
	sb = FileInfo(p).Length
	if sb < mb or kbOnly:
		return '%.3f KB' % (sb / kb)
	else:
		return '%.3f MB' % (sb / mb)

OUT = output(map(getSize, paths) )
# ----------------------------------------

# group: Unique Node Types
string_3 = StringInput("nickname=")
contains = String.Contains(str=split, searchFor=string_3)
code_block_2 = CodeBlock { true; }
code_block_3 = CodeBlock(x=contains, y=code_block_2) { DSCore.List.AllIndicesOf(x,y); }
string_4 = StringInput("type=")
contains_2 = String.Contains(str=split, searchFor=string_4)
code_block_4 = CodeBlock(x=contains_2, y=code_block_2) { DSCore.List.AllIndicesOf(x,y); }
code_block_5 = CodeBlock(a=code_block_3, c=code_block_4) { a+1; c+1; }
create = List.Create(code_block_5.out0, code_block_5.out1)
getItemAtIndex = List.GetItemAtIndex(list=split, index=create)
code_block_6 = CodeBlock(get=getItemAtIndex) { get[0]; }
identity = Object.Identity(code_block_6)
groupByKey = List.GroupByKey(list=code_block_6, keys=identity)
firstItem = List.FirstItem()  # unwired: arg0
map = List.Map(list=groupByKey.groups, f_x=firstItem)
count = List.Count()  # unwired: arg0
map_2 = List.Map(list=groupByKey.groups, f_x=count)
code_block_7 = CodeBlock(get=getItemAtIndex) { get[1]; }
indexOf = IndexOf(code_block_6, map@L1)
getItemAtIndex_2 = List.GetItemAtIndex(list=code_block_7, index=indexOf)
string_5 = StringInput("Name value=")
contains_3 = String.Contains(str=split, searchFor=string_5)
code_block_8 = CodeBlock(x=contains_3, y=code_block_2) { DSCore.List.AllIndicesOf(x,y); }
code_block_9 = CodeBlock(a=code_block_8) { a+1; }
getItemAtIndex_3 = List.GetItemAtIndex(list=split, index=code_block_9)
identity_2 = Object.Identity(code_block_7)
groupByKey_2 = List.GroupByKey(list=code_block_7, keys=identity_2)
map_3 = List.Map(list=groupByKey_2.groups, f_x=firstItem)
map_4 = List.Map(list=groupByKey_2.groups, f_x=count)
sum = Math.Sum(map_2)

# group: Extract Content of Installed Packages
code_block_10 = CodeBlock(get=split) { get[1]; }
string_6 = StringInput("C:\Users\")
# note: User Name
python_script_2 = Python()
# ---------- python_script_2.python (8 lines) ----------
import clr
import sys

pyt_path = r'C:\Program Files (x86)\IronPython 2.7\Lib'
sys.path.append(pyt_path)

import os
OUT = os.environ.get( "USERNAME" )
# ----------------------------------------
string_7 = StringInput("\AppData\Roaming\Dynamo\Dynamo Revit")
code_block_11 = CodeBlock(a=string_6, b=python_script_2, c=string_7) { a+b+c; }
code_block_12 = CodeBlock { "*"; }
directory_contents_from_list_py = Python(IN[0]=code_block_11, IN[1]=code_block_12)
# ---------- directory_contents_from_list_py.python (13 lines) ----------
from System.IO import Directory, SearchOption
dirs = IN[0]
searchstring = IN[1]

files = []

if not isinstance(dirs, list): dirs = [dirs]

for dir in dirs:
	if Directory.Exists(dir):
		files.append(Directory.GetFiles(dir, searchstring, SearchOption.AllDirectories))

OUT = files
# ----------------------------------------
flatten = Flatten(directory_contents_from_list_py)
string_from_object_2 = FromObject(flatten)
string_8 = StringInput("DynamoSettings.xml")
contains_4 = String.Contains(str=string_from_object_2, searchFor=string_8)
code_block_13 = CodeBlock(x=contains_4, y=code_block_2) { DSCore.List.AllIndicesOf(x,y); }
getItemAtIndex_4 = List.GetItemAtIndex(list=string_from_object_2, index=code_block_13)
code_block_14 = CodeBlock { 3; }
length = String.Length(code_block_10)
code_block_15 = CodeBlock(a=length, b=code_block_14) { a-b; }
remove = String.Remove(str=code_block_10, startIndex=code_block_14, count=code_block_15)
contains_5 = String.Contains(str=getItemAtIndex_4, searchFor=remove)
filterByBoolMask = List.FilterByBoolMask(list=getItemAtIndex_4, mask=contains_5)
isEmpty = List.IsEmpty(filterByBoolMask.in)
lastItem_2 = List.LastItem(filterByBoolMask.out)
if_ = If(test=isEmpty, true=lastItem_2, false=filterByBoolMask.in)
fromPath_2 = FileObject(if_)  # "File.FromPath"
readText_2 = File.ReadText(fromPath_2)
string_9 = StringInput("<CustomPackageFolders>")
string_10 = StringInput("</CustomPackageFolders>")
split_3 = String.Split(readText_2, string_9, string_10)
flatten_2 = Flatten(split_3)
code_block_16 = CodeBlock(get=flatten_2) { get[1]; }
string_11 = StringInput("<string>")
string_12 = StringInput("</string>")
split_4 = String.Split(code_block_16, string_11, string_12)
trimWhitespace = String.TrimWhitespace(split_4)
length_2 = String.Length(trimWhitespace)
code_block_17 = CodeBlock { 0; }
eq = length_2 == code_block_17
filterByBoolMask_2 = List.FilterByBoolMask(list=trimWhitespace, mask=eq)
code_block_18 = CodeBlock { "*"; }
directory_contents_from_list_py_2 = Python(IN[0]=filterByBoolMask_2.out, IN[1]=code_block_18)  # same code as directory_contents_from_list_py
string_from_object_3 = FromObject(directory_contents_from_list_py_2)
string_13 = StringInput(".dyf")
contains_6 = String.Contains(str=string_from_object_3, searchFor=string_13)

# group: Extract Zero Touch Node Packages
string_14 = StringInput("nickname=")
string_15 = StringInput("assembly=")
string_16 = StringInput("assemblyName=")
split_5 = String.Split(readText, string_14, string_15, string_16)
string_17 = StringInput(".dll")
contains_7 = String.Contains(str=split_5, searchFor=string_17)
code_block_19 = CodeBlock { true; }
code_block_20 = CodeBlock(x=contains_7, y=code_block_19) { DSCore.List.AllIndicesOf(x,y); }
getItemAtIndex_5 = List.GetItemAtIndex(list=split_5, index=code_block_20)
string_18 = StringInput("\"")
split_6 = String.Split(getItemAtIndex_5, string_18)
firstItem_2 = List.FirstItem()  # unwired: arg0
map_5 = List.Map(list=split_6, f_x=firstItem_2)
code_block_21 = CodeBlock(a=code_block_20) { a-1; }
getItemAtIndex_6 = List.GetItemAtIndex(list=split_5, index=code_block_21)
split_7 = String.Split(getItemAtIndex_6, string_18)
map_6 = List.Map(list=split_7, f_x=firstItem_2)
uniqueItems = List.UniqueItems(map_6)
indexOf_2 = IndexOf(map_6, uniqueItems@L1)
getItemAtIndex_7 = List.GetItemAtIndex(list=map_5, index=indexOf_2)
string_19 = StringInput("\")
split_8 = String.Split(getItemAtIndex_7, string_19)
lastItem_3 = List.LastItem()  # unwired: arg0
map_7 = List.Map(list=split_8, f_x=lastItem_3)
code_block_22 = CodeBlock { "RevitNodes.dll"; "Revit Core"; "DSCoreNodes.dll"; "Dynamo Core"; }
replace = String.Replace(str=map_7, searchFor=code_block_22.out0, replaceWith=code_block_22.out1)
replace_2 = String.Replace(str=replace, searchFor=code_block_22.out2, replaceWith=code_block_22.out3)
code_block_23 = CodeBlock { "DSOffice.dll"; "ProtoGeometry.dll"; }
replace_3 = String.Replace(str=replace_2, searchFor=code_block_23.out0, replaceWith=code_block_22.out3)
replace_4 = String.Replace(str=replace_3, searchFor=code_block_23.out1, replaceWith=code_block_22.out3)
string_20 = StringInput(".dll")
string_21 = StringInput(".xml")
replace_5 = String.Replace(str=getItemAtIndex_7, searchFor=string_20, replaceWith=string_21)
readText_3 = File.ReadText(replace_5)
string_22 = StringInput("<name>")
string_23 = StringInput("</name>")
split_9 = String.Split(readText_3, string_22, string_23)
code_block_24 = CodeBlock { 1; }
getItemAtIndex_8 = List.GetItemAtIndex(index=code_block_24)  # unwired: list
map_8 = List.Map(list=split_9, f_x=getItemAtIndex_8)
isNull = Object.IsNull(map_8)
code_block_25 = CodeBlock { false; }
code_block_26 = CodeBlock(x=isNull, y=code_block_25) { DSCore.List.AllIndicesOf(x,y); }
getItemAtIndex_9 = List.GetItemAtIndex(list=map_8, index=code_block_26)
python_script_3 = Python(IN[0]=replace_4, IN[1]=getItemAtIndex_9, IN[2]=code_block_26)
# ---------- python_script_3.python (8 lines) ----------
_list = IN[0]
rValues = IN[1]
iValues = IN[2]
if len(iValues) > 1 and len(rValues) == 1:
	rValues = [rValues[0]] * len(iValues)
for (index, value) in zip(iValues, rValues):
	_list[index] = value
OUT = _list
# ----------------------------------------
code_block_27 = CodeBlock(item=python_script_3) { Flatten({item}); }
indexOf_3 = IndexOf(map, uniqueItems@L1)
code_block_28 = CodeBlock(item=indexOf_3) { Flatten({item}); }
python_script_4 = Python(IN[0]=getItemAtIndex_2, IN[1]=code_block_27, IN[2]=code_block_28)  # same code as python_script_3

# group: Output Consolidation
code_block_29 = CodeBlock()
# ---------- code_block_29.designscript (11 lines) ----------
"Filename";
"File Size";
"Workspace Version";
"Total Connectors";
"Unique Node Names";
"Unique Node Numbers";
"Unique Node Types";
"Unique Node Packages";
"Node Types";
"Node Types Totals";
"Total Nodes";
# ----------------------------------------
addItemToFront = List.AddItemToFront(item=code_block_29.out0, list=lastItem)
addItemToFront_2 = List.AddItemToFront(item=code_block_29.out1, list=python_script)
addItemToFront_3 = List.AddItemToFront(item=code_block_29.out2, list=code_block_10)
string_24 = StringInput("<Dynamo.Graph.Connector")
contains_8 = String.Contains(str=split, searchFor=string_24)
countTrue = CountTrue(contains_8)
addItemToFront_4 = List.AddItemToFront(item=code_block_29.out3, list=countTrue)
addItemToFront_5 = List.AddItemToFront(item=code_block_29.out4, list=map)
addItemToFront_6 = List.AddItemToFront(item=code_block_29.out5, list=map_2)
addItemToFront_7 = List.AddItemToFront(item=code_block_29.out6, list=getItemAtIndex_2)
addItemToFront_8 = List.AddItemToFront(item=code_block_29.out8, list=map_3)
addItemToFront_9 = List.AddItemToFront(item=code_block_29.out9, list=map_4)
addItemToFront_10 = List.AddItemToFront(item=code_block_29.out10, list=sum)

# group: Node Info Output
create_2 = List.Create(addItemToFront, addItemToFront_2, addItemToFront_3)
FileInfo = Output(create_2)
TotalConnectors = Output(addItemToFront_4)
create_3 = List.Create(addItemToFront_8, addItemToFront_9)
NodeTypeInfo = Output(create_3)
TotalNodes = Output(addItemToFront_10)

# group: Replace Default Node Type Naming with Standards
code_block_30 = CodeBlock { "Revit Core"; "Dynamo Core"; }
code_block_31 = CodeBlock { "DSRevit"; }
contains_9 = String.Contains(searchFor=code_block_31)  # unwired: str
replaceByCondition = Replace(python_script_4, code_block_30.out0, contains_9)
code_block_32 = CodeBlock { "CoreNode"; "Python"; "ZeroTouch"; "CodeBlock"; }
contains_10 = String.Contains(searchFor=code_block_32.out0)  # unwired: str
replaceByCondition_2 = Replace(replaceByCondition, code_block_30.out1, contains_10)
contains_11 = String.Contains(searchFor=code_block_32.out1)  # unwired: str
replaceByCondition_3 = Replace(replaceByCondition_2, code_block_30.out1, contains_11)
contains_12 = String.Contains(searchFor=code_block_32.out2)  # unwired: str
replaceByCondition_4 = Replace(replaceByCondition_3, code_block_30.out1, contains_12)
code_block_33 = CodeBlock { "Dynamo.Nodes"; }
contains_13 = String.Contains(searchFor=code_block_33)  # unwired: str
replaceByCondition_5 = Replace(replaceByCondition_4, code_block_30.out1, contains_13)
contains_14 = String.Contains(searchFor=code_block_32.out3)  # unwired: str
replaceByCondition_6 = Replace(replaceByCondition_5, code_block_30.out1, contains_14)
code_block_34 = CodeBlock { "CustomNodes"; }
contains_15 = String.Contains(str=replaceByCondition_6, searchFor=code_block_34)
code_block_35 = CodeBlock { true; }
code_block_36 = CodeBlock(x=contains_15, y=code_block_35) { DSCore.List.AllIndicesOf(x,y); }
getItemAtIndex_10 = List.GetItemAtIndex(list=map, index=code_block_36)
code_block_37 = CodeBlock(a=getItemAtIndex_3) { a; }
identity_3 = Object.Identity(code_block_37)
groupByKey_3 = List.GroupByKey(list=code_block_37, keys=identity_3)
firstItem_3 = List.FirstItem()  # unwired: arg0
map_9 = List.Map(list=groupByKey_3.groups, f_x=firstItem_3)
eq_2 = getItemAtIndex_10 == map_9
if_2 = If(test=eq_2, true=getItemAtIndex_10, false=code_block_37)

# group: Extract Custom Node Packages
filterByBoolMask_3 = List.FilterByBoolMask(list=string_from_object_3, mask=contains_6)
flatten_3 = Flatten(filterByBoolMask_3.in)
fromPath_3 = FileObject(flatten_3)  # "File.FromPath"
readText_4 = File.ReadText(fromPath_3)
string_25 = StringInput("\"")
split_10 = String.Split(readText_4, string_25)
code_block_38 = CodeBlock { 15; }
takeItems = List.TakeItems(amount=code_block_38)  # unwired: list
map_10 = List.Map(list=split_10, f_x=takeItems)
trimWhitespace_2 = String.TrimWhitespace(map_10)
string_26 = StringInput("Name=")
indexOf_4 = IndexOf(trimWhitespace_2@L2, string_26@L1, lacing=Longest)
code_block_39 = CodeBlock(a=indexOf_4) { a+1; }
getItemAtIndex_11 = List.GetItemAtIndex(list=trimWhitespace_2@L2, index=code_block_39@L1)
string_from_object_4 = FromObject(if_2)
allIndicesOf = List.AllIndicesOf(list=getItemAtIndex_11, item=string_from_object_4)
lastItem_4 = List.LastItem()  # unwired: arg0
map_11 = List.Map(list=allIndicesOf, f_x=lastItem_4)
getItemAtIndex_12 = List.GetItemAtIndex(list=flatten_3, index=map_11)
string_27 = StringInput("\dyf")
split_11 = String.Split(getItemAtIndex_12, string_27)
code_block_40 = CodeBlock { "Unresolved- Try Using What-the-Node from the Rhythm Package"; }
python_script_5 = Python(IN[0]=split_11, IN[1]=code_block_40)
# ---------- python_script_5.python (8 lines) ----------
items = IN[0]
rep = IN[1]
elementlist = list()
for item in items:
	if item is None: 
		item = rep
	elementlist.append(item)
OUT = elementlist
# ----------------------------------------
firstItem_4 = List.FirstItem()  # unwired: arg0
map_12 = List.Map(list=python_script_5, f_x=firstItem_4)
string_28 = StringInput("\pkg.json")
code_block_41 = CodeBlock(a=map_12, b=string_28) { a+b; }
fromPath_4 = FileObject(code_block_41)  # "File.FromPath"
readText_5 = File.ReadText(fromPath_4)
string_29 = StringInput("name\":\"")
string_30 = StringInput("version\":\"")
string_31 = StringInput("\",\"")
split_12 = String.Split(readText_5, string_29, string_30, string_31)
create_4 = List.Create(code_block_40)
python_script_6 = Python(IN[0]=split_12, IN[1]=create_4)  # same code as python_script_5
transpose = List.Transpose(python_script_6)
code_block_42 = CodeBlock(get=transpose) { get[2]; }
code_block_43 = CodeBlock(get=transpose) { get[3]; }
code_block_44 = CodeBlock(a=code_block_42, b=code_block_43) { a+" "+b; }

# group (continued): Replace Default Node Type Naming with Standards
python_script_7 = Python(IN[0]=replaceByCondition_6, IN[1]=code_block_44, IN[2]=code_block_36)  # same code as python_script_3
isNull_2 = Object.IsNull(python_script_7)
if_3 = If(test=isNull_2, true=replaceByCondition_6, false=python_script_7)

eq_3 = if_3 == _  # unwired: arg1

# group (continued): Replace Default Node Type Naming with Standards
if_4 = If(test=eq_3, true=code_block_40, false=if_3)

# group (continued): Output Consolidation
addItemToFront_11 = List.AddItemToFront(item=code_block_29.out7, list=if_4)

# group (continued): Node Info Output
create_5 = List.Create(addItemToFront_5, addItemToFront_6, addItemToFront_7, addItemToFront_11)
UniqueNodeInfo = Output(create_5)

# group: Output CSV
CreateReport = Input(CreateReport: bool=false)
string_from_object_5 = FromObject(fromPath)
code_block_45 = CodeBlock { ".dyn"; "_Audit.csv"; }
replace_6 = String.Replace(str=string_from_object_5, searchFor=code_block_45.out0, replaceWith=code_block_45.out1)
code_block_46 = CodeBlock { "null"; }
if_5 = If(test=CreateReport, true=replace_6, false=code_block_46)
create_6 = List.Create(addItemToFront, addItemToFront_2, addItemToFront_3, addItemToFront_4, addItemToFront_5, addItemToFront_6, addItemToFront_7, addItemToFront_11, addItemToFront_8, addItemToFront_9, addItemToFront_10)
transpose_2 = List.Transpose(create_6)
writeToFile = CSV.WriteToFile(if_5, transpose_2)

# group: Input Data to Embed
transpose_3 = List.Transpose(transpose_2)
code_block_47 = CodeBlock { true; }
clean = List.Clean(list=transpose_3, preserveIndices=code_block_47)
code_block_48 = CodeBlock(TransposedListInput=clean) { TransposedListInput; }
code_block_49 = CodeBlock(get=code_block_48) { get[0]; }
indexOf_5 = IndexOf(code_block_48, code_block_49)
firstItem_5 = List.FirstItem(code_block_49)
indexOf_6 = IndexOf(code_block_49, firstItem_5)
string_32 = StringInput("\"//")
code_block_50 = CodeBlock(a=string_32, b=firstItem_5) { a+b; }
replaceItemAtIndex = List.ReplaceItemAtIndex(list=code_block_49, index=indexOf_6, item=code_block_50)
replaceItemAtIndex_2 = List.ReplaceItemAtIndex(list=code_block_48, index=indexOf_5, item=replaceItemAtIndex)
count_2 = Count(code_block_48)
code_block_51 = CodeBlock(a=count_2) { a-1; }
code_block_52 = CodeBlock(get=code_block_48, x=code_block_51) { get[x]; }
indexOf_7 = IndexOf(code_block_48, code_block_52)
lastItem_5 = List.LastItem(code_block_52)
indexOf_8 = IndexOf(code_block_52, lastItem_5)
string_33 = StringInput("\"")
code_block_53 = CodeBlock(a=lastItem_5, b=string_33) { a+b; }
replaceItemAtIndex_3 = List.ReplaceItemAtIndex(list=code_block_52, index=indexOf_8, item=code_block_53)
replaceItemAtIndex_4 = List.ReplaceItemAtIndex(list=replaceItemAtIndex_2, index=indexOf_7, item=replaceItemAtIndex_3)
string_34 = StringInput("&#xA;//")
code_block_54 = CodeBlock(a=replaceItemAtIndex_4, b=string_34) { a+b; }
lastItem_6 = List.LastItem(code_block_54)
lastItem_7 = List.LastItem(lastItem_6)
indexOf_9 = IndexOf(lastItem_6, lastItem_7)
string_35 = StringInput("&#xA;//")
split_13 = String.Split(lastItem_7, string_35)
replaceItemAtIndex_5 = List.ReplaceItemAtIndex(list=lastItem_6, index=indexOf_9, item=split_13)
flatten_4 = Flatten(replaceItemAtIndex_5)
replaceItemAtIndex_6 = List.ReplaceItemAtIndex(list=code_block_54, index=code_block_51, item=flatten_4)

# group: Output Audited DYN
CreateAuditedDYN = Input(CreateAuditedDYN: bool=false)
fromPath_5 = FileObject(FilePath)  # "File.FromPath"
string_from_object_6 = FromObject(fromPath_5)
string_36 = StringInput(".dyn")
string_37 = StringInput("_Audit.dyn")
replace_7 = String.Replace(str=string_from_object_6, searchFor=string_36, replaceWith=string_37)
code_block_55 = CodeBlock { "null"; }
if_6 = If(test=CreateAuditedDYN, true=replace_7, false=code_block_55)
readText_6 = File.ReadText(fromPath_5)
string_38 = StringInput("  </Elements>")
split_14 = String.Split(readText_6, string_38)
code_block_56 = CodeBlock(get=split_14) { get[0]; get[1]; }
string_39 = StringInput("    <Dynamo.Graph.Nodes.CodeBlockNodeModel guid=\"e6614f5c-757e-4607-be73-74fb9ffe4933\" type=\"Dynamo.Graph.Nodes.CodeBlockNodeModel\" nickname=\"Sastrugi - Audit Information ")
now = DateTime.Now()
string_40 = StringInput("\" x=\"")
string_41 = StringInput("\"")
split_15 = String.Split(readText_6, string_41)
trimWhitespace_3 = String.TrimWhitespace(split_15)
string_42 = StringInput("x=")
allIndicesOf_2 = List.AllIndicesOf(list=trimWhitespace_3, item=string_42)
code_block_57 = CodeBlock(a=allIndicesOf_2) { a+1; }
getItemAtIndex_13 = List.GetItemAtIndex(list=trimWhitespace_3, index=code_block_57)
toNumber = String.ToNumber(getItemAtIndex_13)
average = Math.Average(toNumber)
string_from_object_7 = FromObject(average)
string_43 = StringInput("\" y=\"")
string_44 = StringInput("y=")
allIndicesOf_3 = List.AllIndicesOf(list=trimWhitespace_3, item=string_44)
code_block_58 = CodeBlock(a=allIndicesOf_3) { a+1; }
getItemAtIndex_14 = List.GetItemAtIndex(list=trimWhitespace_3, index=code_block_58)
toNumber_2 = String.ToNumber(getItemAtIndex_14)
average_2 = Math.Average(toNumber_2)
string_from_object_8 = FromObject(average_2)
string_45 = StringInput("\" isVisible=\"true\" isUpstreamVisible=\"true\" lacing=\"Disabled\" isSelectedInput=\"False\" IsFrozen=\"false\" isPinned=\"false\" CodeText=")
flatten_5 = Flatten(replaceItemAtIndex_6)
concat = String.Concat(flatten_5)
string_46 = StringInput(" ShouldFocus=\"false\" />")
code_block_59 = CodeBlock(a=string_39, b=now, c=string_40, d=string_from_object_7, e=string_43, f=string_from_object_8, g=string_45, h=concat, j=string_46) { a+b+c+d+e+f+g+h+j; }
string_47 = StringInput("\n  </Elements>")
create_7 = List.Create(code_block_56.out0, code_block_59, string_47, code_block_56.out1)
flatten_6 = Flatten(create_7)
concat_2 = String.Concat(flatten_6)
writeText = File.WriteText(if_6, concat_2)
