# Dynamo custom node __Convert Dynamo XYZ to Revit Coordinate XYZ.dyf "❄_Convert Dynamo XYZ to Revit Coordinate XYZ" (Dynamo 1.3.2.2480)
# category: Sastrugi.Points
# (Sastrugi_Points) Convert a Point (XYZ) in Dynamo to Revit Shared Coordinates (XYZ).

PointX = Input()
PointY = Input()
code_block = CodeBlock { 0; }
byCoordinates = Point.ByCoordinates(x=PointX, y=PointY, z=code_block)
identity = CoordinateSystem.Identity()
element_types = ElementTypes("BasePoint")
all_elements_of_type = ElementsOfType(element_types)
lastItem = List.LastItem(all_elements_of_type)
code_block_2 = CodeBlock()
# ---------- code_block_2.designscript (2 lines) ----------
{"E/W","N/S","Elev",
"Angle to True North"};
# ----------------------------------------
getParameterValueByName = Element.GetParameterValueByName(element=lastItem, parameterName=code_block_2)
code_block_3 = CodeBlock(bp=getParameterValueByName) { bp[0]; bp[1]; bp[2]; 360-bp[3]; }
byOrigin = CoordinateSystem.ByOrigin(code_block_3.out0, code_block_3.out1, code_block_3.out2)
origin = CoordinateSystem.Origin(byOrigin)
ZAxis = Vector.ZAxis()
rotate = CoordinateSystem.Rotate(coordinateSystem=byOrigin, origin=origin, axis=ZAxis, degrees=code_block_3.out3)
transform = Geometry.Transform(geometry=byCoordinates, fromCoordinateSystem=identity, contextCoordinateSystem=rotate)
Y = Point.Y(transform)
N_S = Output(Y)  # "N/S"
X = Point.X(transform)
E_W = Output(X)  # "E/W"
PointZ = Input()
code_block_4 = CodeBlock(a=code_block_3.out2, b=PointZ) { a+b; }
Elev = Output(code_block_4)
