# Dynamo custom node __Copy Filter Overrides to Views.dyf "❄_Copy Filter Overrides to Views" (Dynamo 1.3.2.2480)
# category: Sastrugi.Graphics
# (Sastrugi_Graphics) This node copies the override values of a Filter in a reference View to other Views.

OtherViews = Input()
ReferenceView = Input()
filters = View.Filters(ReferenceView)
id = Element.Id(filters)
Filter = Input(Filter: ParameterFilterElement)
id_2 = Element.Id(Filter)
eq = id == id_2
filterByBoolMask = List.FilterByBoolMask(list=filters, mask=eq)
count = Count(OtherViews)
ofRepeatedItem = List.OfRepeatedItem(item=filterByBoolMask.in, amount=count)
filterOverrides = View.FilterOverrides(ReferenceView, filterByBoolMask.in)
ofRepeatedItem_2 = List.OfRepeatedItem(item=filterOverrides, amount=count)
code_block = CodeBlock(view=ReferenceView, filter=filterByBoolMask.in) { RevitElements.View.GetFilterVisibility(view,filter); }
ofRepeatedItem_3 = List.OfRepeatedItem(item=code_block, amount=count)
setFilterOverrides = View.SetFilterOverrides(view=OtherViews, parameterFilter=ofRepeatedItem, overrides=ofRepeatedItem_2, hide=ofRepeatedItem_3)
flatten = Flatten(setFilterOverrides)
isNull = Object.IsNull(flatten)
code_block_2 = CodeBlock(x=isNull)
# ---------- code_block_2.designscript (3 lines) ----------
x==false ?
"Yes":
"No";
# ----------------------------------------
DidItWork = Output(code_block_2)
