# Dynamo custom node __Copy_Filter_Overrides_to_Views.dyf "❄_Copy Filter Overrides to Views" (Dynamo 2.2.1.5175)
# category: Sastrugi.Graphics
# (Sastrugi_Graphics) This node copies the override values of a Filter in a reference View to other Views.

OtherViews = Input(OtherViews: var[]..[])
ReferenceView = Input(ReferenceView: var[]..[])
filters = View.Filters(view=ReferenceView)
id = Element.Id(element=filters)
InputFilter = Input(InputFilter: var[]..[])  # This needs to be a ParameterFilterElement
id_2 = Element.Id(element=InputFilter)
eq = id == id_2
filterByBoolMask = List.FilterByBoolMask(list=filters, mask=eq)
count = List.Count(list=OtherViews)
ofRepeatedItem = List.OfRepeatedItem(item=filterByBoolMask.in, amount=count)
filterOverrides = View.FilterOverrides(view=ReferenceView, parameterFilter=filterByBoolMask.in)
ofRepeatedItem_2 = List.OfRepeatedItem(item=filterOverrides, amount=count)
python_script = Python(IN[0]=ReferenceView, IN[1]=filterByBoolMask.in)
# ---------- python_script.python (11 lines) ----------
import clr
clr.AddReference('RevitAPI')
import Autodesk
from Autodesk.Revit.DB import *

view = UnwrapElement(IN[0])
filter = IN[1]

x = view.GetFilterVisibility(ElementId(filter[0].Id))

OUT = x
# ----------------------------------------
ofRepeatedItem_3 = List.OfRepeatedItem(item=python_script, amount=count)
setFilterOverrides = View.SetFilterOverrides(view=OtherViews, parameterFilter=ofRepeatedItem, overrides=ofRepeatedItem_2, hide=ofRepeatedItem_3)
flatten = List.Flatten(list=setFilterOverrides)
isNull = Object.IsNull(obj=flatten)
code_block = CodeBlock(x=isNull)
# ---------- code_block.designscript (3 lines) ----------
x==false ?
"Yes":
"No";
# ----------------------------------------
DidItWork = Output(code_block)
