# Dynamo custom node __Count and Repeat.dyf "❄_Count and Repeat" (Dynamo 1.3.2.2480)
# category: Sastrugi.Lists
# (Sastrugi_Lists) This node counts the number of items in a given list and then repeats an Item based on that counted number.

CountItems = Input()
RepeatThis = Input()
code_block = CodeBlock(list=CountItems, y=RepeatThis) { x=DSCore.List.Count(list); DSCore.List.OfRepeatedItem(y,x); }
Output = Output(code_block.out1)
