# Dynamo custom node __Count_and_Repeat.dyf "❄_Count and Repeat" (Dynamo 2.0.3.8810)
# category: Sastrugi.Lists
# (Sastrugi_Lists) This node counts the number of items in a given list and then repeats an Item based on that counted number.

CountItems = Input(CountItems: var[]..[])
RepeatThis = Input(RepeatThis: var[]..[])
code_block = CodeBlock(list=CountItems, y=RepeatThis) { x=DSCore.List.Count(list); DSCore.List.OfRepeatedItem(y,x); }
Output = Output(code_block.out1)
