# Dynamo custom node __Delete_DYN_and_DYF_Backup_Files.dyf "❄_Delete DYN and DYF Backup Files" (Dynamo 2.0.3.8810)
# category: Sastrugi.Management
# (Sastrugi_Management) This node deletes backup files created for Nodes and Scripts, from the specified directory.

code_block = CodeBlock { null; }
DirectoryPath = Input(DirectoryPath: var[]..[])
code_block_2 = CodeBlock { "*"; }

# group: Credit #Clockwork for coding
directory_contents_from_list_py = Python(IN[0]=DirectoryPath, IN[1]=code_block_2)
# ---------- directory_contents_from_list_py.python (13 lines) ----------
from System.IO import Directory, SearchOption
dirs = IN[0]
searchstring = IN[1]

files = []

if not isinstance(dirs, list): dirs = [dirs]

for dir in dirs:
	if Directory.Exists(dir):
		files.append(Directory.GetFiles(dir, searchstring, SearchOption.AllDirectories))

OUT = files
# ----------------------------------------

code_block_3 = CodeBlock { "Backup.dyf"; "Backup.dyn"; true; }
contains = String.Contains(str=directory_contents_from_list_py, searchFor=code_block_3.out0, ignoreCase=code_block_3.out2)
contains_2 = String.Contains(str=directory_contents_from_list_py, searchFor=code_block_3.out1, ignoreCase=code_block_3.out2)
or_ = contains || contains_2
filterByBoolMask = List.FilterByBoolMask(list=directory_contents_from_list_py, mask=or_)
eq = code_block == filterByBoolMask.in
code_block_4 = CodeBlock { "Denied Permission to Continue, Check Folder Access Settings"; }
if_ = If(test=eq, true=code_block_4, false=filterByBoolMask.in)
code_block_5 = CodeBlock(df=if_) { df; }
code_block_6 = CodeBlock(wait=code_block_5, pass=filterByBoolMask.in) { [wait,pass][0]; }
deleteFile = FileSystem.DeleteFile(path=code_block_6)
DeletedFiles = Output(code_block_5)
