# Dynamo custom node __Find Coincident Reference Planes.dyf "❄_Find Coincident Reference Planes" (Dynamo 1.3.3.4111)
# category: Sastrugi.Geometry
# (Sastrugi_Geometry) This node groups Reference Planes that are coincident.

ReferencePlanes = Input()

# group: Filter By Vector
code_block = CodeBlock(list=ReferencePlanes) { Flatten({list}); }
plane = ReferencePlane.Plane(code_block)
normal = Plane.Normal(plane)
angleWithVector = Vector.AngleWithVector(vector=normal, otherVector=normal, lacing=CrossProduct)
round = Math.Round()  # unwired: arg0
map = List.Map(list=angleWithVector, f_x=round)
code_block_2 = CodeBlock(a=map)
# ---------- code_block_2.designscript (3 lines) ----------
a==0?
true:
false;
# ----------------------------------------
code_block_3 = CodeBlock(a=map)
# ---------- code_block_3.designscript (3 lines) ----------
a==180?
true:
false;
# ----------------------------------------
code_block_4 = CodeBlock(a=code_block_2, b=code_block_3) { {a,b}; }
transpose = List.Transpose(code_block_4)
countTrue = CountTrue()  # unwired: arg0
map_2 = List.Map(list=transpose, f_x=countTrue)
code_block_5 = CodeBlock(a=map_2)
# ---------- code_block_5.designscript (3 lines) ----------
a==1?
true:
false;
# ----------------------------------------
filterByBoolMask = List.FilterByBoolMask(list=code_block, mask=code_block_5)

# group: Filter By Point
plane_2 = ReferencePlane.Plane(filterByBoolMask.out)
origin = Plane.Origin(plane_2)
closestPointTo = Geometry.ClosestPointTo(geometry=plane_2, other=origin, lacing=CrossProduct)
isAlmostEqualTo = Geometry.IsAlmostEqualTo(closestPointTo, origin@L2, lacing=CrossProduct)
not_ = Not(isAlmostEqualTo, lacing=CrossProduct)
code_block_6 = CodeBlock { false; }
allIndicesOf = List.AllIndicesOf(list=not_@L2, item=code_block_6)
count = Count(allIndicesOf@L2)
code_block_7 = CodeBlock(a=count)
# ---------- code_block_7.designscript (3 lines) ----------
a==1?
false:
true;
# ----------------------------------------
filterByBoolMask_2 = List.FilterByBoolMask(list=allIndicesOf@L2, mask=code_block_7@L2, lacing=Longest)
sortIndexByValue = SortIndexByValue(filterByBoolMask_2.in@L2)
getItemAtIndex = List.GetItemAtIndex(list=filterByBoolMask_2.in@L2, index=sortIndexByValue@L2)
uniqueItems = List.UniqueItems(getItemAtIndex@L3)
count_2 = Count(uniqueItems@L2)
code_block_8 = CodeBlock(a=count_2)  # same code as code_block_7
filterByBoolMask_3 = List.FilterByBoolMask(list=uniqueItems@L3, mask=code_block_8@L2, lacing=Longest)
getItemAtIndex_2 = List.GetItemAtIndex(list=filterByBoolMask.out, index=filterByBoolMask_3.in@L2)

CoincidentElements = Output(getItemAtIndex_2)
