# Dynamo custom node __Find Floating Elements.dyf "❄_Find Floating Elements" (Dynamo 1.3.2.2480)
# category: Sastrugi.Elements
# (Sastrugi_Elements) This node checks if Elements have overlapping geometry with other Elements or are floating in 3D virtual space.

Elements = Input()
flatten = Flatten(Elements)
geometry = Element.Geometry(flatten)
isEmpty = List.IsEmpty(geometry@L2)
filterByBoolMask = List.FilterByBoolMask(list=flatten, mask=isEmpty)
filterByBoolMask_2 = List.FilterByBoolMask(list=geometry, mask=isEmpty)
flatten_2 = Flatten(filterByBoolMask_2.out)
doesIntersect = Geometry.DoesIntersect(geometry=flatten_2, other=flatten_2, lacing=CrossProduct)
countTrue = CountTrue(doesIntersect@L2, lacing=Longest)
code_block = CodeBlock(x=countTrue)
# ---------- code_block.designscript (3 lines) ----------
x==1 ?
true:
false;
# ----------------------------------------
filterByBoolMask_3 = List.FilterByBoolMask(list=filterByBoolMask.out, mask=code_block)
FloatingElements = Output(filterByBoolMask_3.in)
OverlappingElements = Output(filterByBoolMask_3.out)
