# Dynamo custom node __Find_Coincident_Reference_Planes.dyf "❄_Find Coincident Reference Planes" (Dynamo 2.2.1.5175)
# category: Sastrugi.Geometry
# (Sastrugi_Geometry) This node groups Reference Planes that are coincident.

ReferencePlaneList = Input(ReferencePlaneList: var[]..[])

# group: Filter By Vector
flatten = List.Flatten(list=ReferencePlaneList)
plane = ReferencePlane.Plane(referencePlane=flatten)
normal = Plane.Normal(plane=plane)
angleWithVector = Vector.AngleWithVector(vector=normal, otherVector=normal, lacing=CrossProduct)
round = Math.Round()  # unwired: number
map = List.Map(list=angleWithVector, f_x=round)
code_block = CodeBlock(a=map)
# ---------- code_block.designscript (3 lines) ----------
a==0?
true:
false;
# ----------------------------------------
code_block_2 = CodeBlock(a=map)
# ---------- code_block_2.designscript (3 lines) ----------
a==180?
true:
false;
# ----------------------------------------
code_block_3 = CodeBlock(a=code_block, b=code_block_2) { [a,b]; }
transpose = List.Transpose(lists=code_block_3)
countTrue = List.CountTrue()  # unwired: list
map_2 = List.Map(list=transpose, f_x=countTrue)
code_block_4 = CodeBlock(a=map_2)
# ---------- code_block_4.designscript (3 lines) ----------
a==1?
true:
false;
# ----------------------------------------
filterByBoolMask = List.FilterByBoolMask(list=flatten, mask=code_block_4)

# group: Filter By Point
plane_2 = ReferencePlane.Plane(referencePlane=filterByBoolMask.out)
origin = Plane.Origin(plane=plane_2)
closestPointTo = Geometry.ClosestPointTo(geometry=plane_2, other=origin, lacing=CrossProduct)
isAlmostEqualTo = Geometry.IsAlmostEqualTo(geometry=closestPointTo, other=origin@L2, lacing=CrossProduct)
not_ = Not(x=isAlmostEqualTo, lacing=CrossProduct)
code_block_5 = CodeBlock { false; }
allIndicesOf = List.AllIndicesOf(list=not_@L2, item=code_block_5)
count = List.Count(list=allIndicesOf@L2)
code_block_6 = CodeBlock(a=count)
# ---------- code_block_6.designscript (3 lines) ----------
a==1?
false:
true;
# ----------------------------------------
filterByBoolMask_2 = List.FilterByBoolMask(list=allIndicesOf, mask=code_block_6)
sortIndexByValue = List.SortIndexByValue(list=filterByBoolMask_2.in@L2)
getItemAtIndex = List.GetItemAtIndex(list=filterByBoolMask_2.in@L2, index=sortIndexByValue@L2)
uniqueItems = List.UniqueItems(list=getItemAtIndex@L3)
count_2 = List.Count(list=uniqueItems@L2)
code_block_7 = CodeBlock(a=count_2)  # same code as code_block_6
filterByBoolMask_3 = List.FilterByBoolMask(list=uniqueItems@L3, mask=code_block_7@L2, lacing=Longest)
getItemAtIndex_2 = List.GetItemAtIndex(list=filterByBoolMask.out, index=filterByBoolMask_3.in@L2)

CoincidentElements = Output(getItemAtIndex_2)
