# Dynamo custom node __Fit Points by Coordinate Systems.dyf "❄_Fit Points by Coordinate Systems" (Dynamo 1.3.2.2480)
# category: Sastrugi.Points
# (Sastrugi_Points) This node finds the best fit of a series of points with another by using average coordinate systems.

ScaleToFit = Input(ScaleToFit: bool=false)
ReferencePoints = Input()
code_block = CodeBlock(list=ReferencePoints) { Flatten({list}); }
code_block_2 = CodeBlock(ref=code_block) { ref; }
PointsToFit = Input()
code_block_3 = CodeBlock(list=PointsToFit) { Flatten({list}); }
code_block_4 = CodeBlock(move=code_block_3) { move; }
byBestFitThroughPoints = Line.ByBestFitThroughPoints(code_block_4)
code_block_5 = CodeBlock { 0.5; }
coordinateSystemAtParameter = Curve.CoordinateSystemAtParameter(byBestFitThroughPoints, code_block_5)
byBestFitThroughPoints_2 = Line.ByBestFitThroughPoints(code_block_2)
coordinateSystemAtParameter_2 = Curve.CoordinateSystemAtParameter(byBestFitThroughPoints_2, code_block_5)
transform = Geometry.Transform(geometry=code_block_4, fromCoordinateSystem=coordinateSystemAtParameter, contextCoordinateSystem=coordinateSystemAtParameter_2)
distanceTo = Geometry.DistanceTo(geometry=code_block_2, other=transform, lacing=CrossProduct)
flatten = Flatten(distanceTo)
average = Math.Average(flatten)
reverse = Curve.Reverse(byBestFitThroughPoints_2)
coordinateSystemAtParameter_3 = Curve.CoordinateSystemAtParameter(reverse, code_block_5)
transform_2 = Geometry.Transform(geometry=code_block_4, fromCoordinateSystem=coordinateSystemAtParameter, contextCoordinateSystem=coordinateSystemAtParameter_3)
distanceTo_2 = Geometry.DistanceTo(geometry=transform_2, other=transform, lacing=CrossProduct)
flatten_2 = Flatten(distanceTo_2)
average_2 = Math.Average(flatten_2)
code_block_6 = CodeBlock(x=average, y=average_2, a=transform, b=transform_2)
# ---------- code_block_6.designscript (3 lines) ----------
x<=y ?
a:
b;
# ----------------------------------------
XYPlane = CoordinateSystem.XYPlane(coordinateSystemAtParameter_2)
XYPlane_2 = CoordinateSystem.XYPlane(coordinateSystemAtParameter_3)
code_block_7 = CodeBlock(x=average, y=average_2, a=XYPlane, b=XYPlane_2)  # same code as code_block_6
length = Curve.Length(byBestFitThroughPoints_2)
code_block_8 = CodeBlock { null; }
if_ = If(test=ScaleToFit, true=byBestFitThroughPoints, false=code_block_8)
length_2 = Curve.Length(if_)
code_block_9 = CodeBlock(a=length, b=length_2) { a/b; }
scale = Geometry.Scale(code_block_6, code_block_7, code_block_9, code_block_9, code_block_9)
if_2 = If(test=ScaleToFit, true=scale, false=code_block_6)
FittedPoints = Output(if_2)
