# Dynamo custom node __Get Dimension Overrides.dyf "❄_Get Dimension Overrides" (Dynamo 1.3.2.2480)
# category: Sastrugi.Annotations
# (Sastrugi_Annotations) This node extracts any overridden values within the input Dimensions.

Dimensions = Input()
code_block = CodeBlock(list=Dimensions) { Flatten({list}); }
uniqueId = Element.UniqueId(code_block)
ElementUniqueID = Output(uniqueId)
create = List.Create(uniqueId)
python_script = Python(IN[0]=code_block)
# ---------- python_script.python (29 lines) ----------
import clr
clr.AddReference('RevitAPI')
from Autodesk.Revit.DB import *

clr.AddReference('RevitServices')
import RevitServices
from RevitServices.Persistence import DocumentManager
from RevitServices.Transactions import TransactionManager

doc = DocumentManager.Instance.CurrentDBDocument

dimensions = UnwrapElement(IN[0])
params = []

TransactionManager.Instance.EnsureInTransaction(doc)
for i in dimensions:
		param1 = i.Prefix
		param2 = i.Above
		param3 = i.ValueOverride
		param4 = i.Below
		param5 = i.Suffix
		params.append(param1)
		params.append(param2)
		params.append(param3)
		params.append(param4)
		params.append(param5)
TransactionManager.Instance.TransactionTaskDone()	

OUT = params
# ----------------------------------------
code_block_2 = CodeBlock { 5; }
chop = List.Chop(list=python_script, lengths=code_block_2)
transpose = List.Transpose(chop)
join = List.Join(create, transpose)
code_block_3 = CodeBlock { null; }
code_block_4 = CodeBlock { ""; }
eq = _ == code_block_4  # unwired: arg0
replaceByCondition = Replace(join, code_block_3, eq)
code_block_5 = CodeBlock(u=replaceByCondition) { u[1]; u[2]; u[3]; u[4]; u[5]; }
Prefix = Output(code_block_5.out0)
Above = Output(code_block_5.out1)
ValueOverride = Output(code_block_5.out2)
Below = Output(code_block_5.out3)
Suffix = Output(code_block_5.out4)
