# Dynamo custom node __Intersecting_Planes_of_Curves.dyf "❄_Intersecting Planes of Curves" (Dynamo 2.6.1.8786)
# category: Sastrugi.Curves
# (Sastrugi_Curves) This node finds which Plane of Curves intersect with each instance of a Curve Plane.

InputCurves = Input(InputCurves: var[]..[])
flatten = List.Flatten(list=InputCurves)
count = List.Count(list=flatten)
code_block = CodeBlock(n=count) { 0..#n..1; }
string_from_object = FromObject(obj=code_block)
byKeysValues = DesignScript.Builtin.Dictionary.ByKeysValues(keys=string_from_object, values=flatten)
keys = DesignScript.Builtin.Dictionary.Keys(dictionary=byKeysValues)
groupByKey = List.GroupByKey(list=flatten, keys=keys)
OriginalCurves = Output(groupByKey.groups)
startPoint = Curve.StartPoint(curve=flatten)
X = Point.X(point=startPoint)
Y = Point.Y(point=startPoint)
Z = Point.Z(point=startPoint)
code_block_2 = CodeBlock(p=Z) { p+500; }
byCoordinates = Point.ByCoordinates(x=X, y=Y, z=code_block_2)
endPoint = Curve.EndPoint(curve=flatten)
byThreePoints = Plane.ByThreePoints(origin=startPoint, planePoint=byCoordinates, xAxisPoint=endPoint)
flatten_2 = List.Flatten(list=byThreePoints)
doesIntersect = Geometry.DoesIntersect(geometry=flatten_2, other=flatten_2, lacing=CrossProduct)
count_2 = List.Count(list=doesIntersect)
ofRepeatedItem = List.OfRepeatedItem(item=flatten, amount=count_2)
filterByBoolMask = List.FilterByBoolMask(list=ofRepeatedItem, mask=doesIntersect)
indexOf = List.IndexOf(list=filterByBoolMask.in@L2, element=groupByKey.groups@L1)
removeItemAtIndex = List.RemoveItemAtIndex(list=filterByBoolMask.in@L2, indices=indexOf, lacing=Longest)
IntersectingCurves = Output(removeItemAtIndex)
