# Dynamo custom node __Map to the Rainbow.dyf "❄_Map to the Rainbow" (Dynamo 1.3.2.2480)
# category: Sastrugi.Graphics
# (Sastrugi_Graphics) This node maps list items to a color of the Rainbow based on list order.

# group: 0
code_block = CodeBlock()
# ---------- code_block.designscript (8 lines) ----------
a=DSCore.Color.ByARGB(255,148,0,211);
b=DSCore.Color.ByARGB(255,75,0,130);
c=DSCore.Color.ByARGB(255,0,0,255);
d=DSCore.Color.ByARGB(255,0,255,0);
e=DSCore.Color.ByARGB(255,255,255,0);
f=DSCore.Color.ByARGB(255,255,127,0);
g=DSCore.Color.ByARGB(255,255,0,0);
{a,b,c,d,e,f,g};
# ----------------------------------------
code_block_2 = CodeBlock { 0..6; }
add = _ + _  # unwired: arg0, arg1
code_block_3 = CodeBlock { 0; }
List = Input()
code_block_4 = CodeBlock(List=List) { Flatten({List}); }
count = Count(code_block_4)
code_block_5 = CodeBlock(x=count) { 1/x; }
code_block_6 = CodeBlock(list=code_block_4, y=code_block_5) { x=DSCore.List.Count(list); DSCore.List.OfRepeatedItem(y,x); }
scan = ScanList(add, code_block_3, code_block_6.out1)  # "List.Scan"
code_block_7 = CodeBlock { 0; 0.0001; 0.9999; }
replaceItemAtIndex = List.ReplaceItemAtIndex(list=scan, index=code_block_7.out0, item=code_block_7.out1)
replaceItemAtIndex_2 = List.ReplaceItemAtIndex(list=replaceItemAtIndex, index=count, item=code_block_7.out2)
code_block_8 = CodeBlock { 4; }
round = Math.Round(number=replaceItemAtIndex_2, digits=code_block_8)
color_range = ColorRange(code_block.out7, code_block_2, round)
Colors = Output(color_range)
