# Dynamo custom node __Map_to_the_Rainbow.dyf "❄_Map to the Rainbow" (Dynamo 2.2.1.5175)
# category: Sastrugi.Graphics
# (Sastrugi_Graphics) This node maps list items to a color of the Rainbow based on list order.

# group: 0
code_block = CodeBlock()
# ---------- code_block.designscript (8 lines) ----------
a=DSCore.Color.ByARGB(255,148,0,211);
b=DSCore.Color.ByARGB(255,75,0,130);
c=DSCore.Color.ByARGB(255,0,0,255);
d=DSCore.Color.ByARGB(255,0,255,0);
e=DSCore.Color.ByARGB(255,255,255,0);
f=DSCore.Color.ByARGB(255,255,127,0);
g=DSCore.Color.ByARGB(255,255,0,0);
[a,b,c,d,e,f,g];
# ----------------------------------------
code_block_2 = CodeBlock { 0..6; }
add = _ + _  # unwired: x, y
code_block_3 = CodeBlock { 0; }
InputList = Input(InputList: var[]..[])
code_block_4 = CodeBlock { 0; 0.0001; 0.9999; }
code_block_5 = CodeBlock { 4; }

flatten = List.Flatten(list=InputList)

# group (continued): 0
count = List.Count(list=flatten)
code_block_6 = CodeBlock(x=count) { 1/x; }
code_block_7 = CodeBlock(list=flatten, y=code_block_6) { x=DSCore.List.Count(list); DSCore.List.OfRepeatedItem(y,x); }
scan = ScanList(reductor=add, seed=code_block_3, list1=code_block_7.out1)  # "List.Scan"
replaceItemAtIndex = List.ReplaceItemAtIndex(list=scan, index=code_block_4.out0, item=code_block_4.out1)
replaceItemAtIndex_2 = List.ReplaceItemAtIndex(list=replaceItemAtIndex, index=count, item=code_block_4.out2)
round = Math.Round(number=replaceItemAtIndex_2, digits=code_block_5)
color_range = ColorRange(colors=code_block.out7, indices=code_block_2, value=round)
Colors = Output(color_range)
