# Dynamo custom node __Override Projection Line Color in Views.dyf "❄_Override Projection Line Color in Views" (Dynamo 1.3.3.4111)
# category: Sastrugi.Graphics
# (Sastrugi_Graphics) This node will override the Projection Line color of multiple Elements in their owner views.

Elements = Input()
code_block = CodeBlock(item=Elements) { Flatten({item}); }
Color = Input()
code_block_2 = CodeBlock(item=Color) { Flatten({item}); }

# group: Credit #Clockwork for coding
python_script = Python(IN[0]=code_block)
# ---------- python_script.python (16 lines) ----------
import clr
clr.AddReference('RevitAPI')
from Autodesk.Revit.DB import *

clr.AddReference("RevitNodes")
import Revit
clr.ImportExtensions(Revit.Elements)

items = UnwrapElement(IN[0])
elementlist = list()
for item in items:
	try:
		elementlist.append(item.Document.GetElement(item.OwnerViewId).ToDSType(True))
	except:
		elementlist.append(None)
OUT = elementlist
# ----------------------------------------

count = Count(code_block)
code_block_3 = CodeBlock(x=count) { 0..(x-1); }

# group: Credit to @john pierson for the coding
python_script_2 = Python(IN[0]=code_block, IN[1]=code_block_2, IN[2]=python_script, IN[3]=code_block_3)
# ---------- python_script_2.python (59 lines) ----------
import clr
clr.AddReference('ProtoGeometry')
from Autodesk.DesignScript.Geometry import *

clr.AddReference("RevitNodes")
import Revit
clr.ImportExtensions(Revit.Elements)

clr.AddReference("RevitServices")
import RevitServices
from RevitServices.Persistence import DocumentManager
from RevitServices.Transactions import TransactionManager

from System.Collections.Generic import *

clr.AddReference("RevitAPI")
import Autodesk

doc = DocumentManager.Instance.CurrentDBDocument
uiapp = DocumentManager.Instance.CurrentUIApplication
app = uiapp.Application

dataEnteringNode = IN
listlength = UnwrapElement(IN[3])

elements = []
for i in IN[0]:
	elements.append(UnwrapElement(i))

viewlist = []
for j in IN[2]:
	viewlist.append(UnwrapElement(j))

gSettings = Autodesk.Revit.DB.OverrideGraphicSettings()

dsColor = []
for c in IN[1]:
	colRed = c.Red
	colGreen = c.Green
	colBlue = c.Blue
	color = Autodesk.Revit.DB.Color(colRed, colGreen, colBlue)

gSettings.SetProjectionLineColor(color)

TransactionManager.Instance.EnsureInTransaction(doc)

result = []

for k in listlength:
	try:
		id = elements[k].Id
		viewlist[k].SetElementOverrides(id, gSettings)
		result.append("It worked!!")
	except:
		result.append("It didn't work...")
	
TransactionManager.Instance.TransactionTaskDone()

OUT = elements, result
# ----------------------------------------

code_block_4 = CodeBlock(t=python_script_2) { t[0]; t[1]; }
Status = Output(code_block_4.out1)
Elements_2 = Output(code_block_4.out0)  # "Elements"
