# Dynamo custom node __Pick Points on Workplane.dyf "❄_Pick Points on Workplane" (Dynamo 1.3.3.4111)
# category: Sastrugi.Selection
# (Sastrugi_Selection) This node allows users to pick points in Revit on the Active Workplane.

code_block = CodeBlock()
# ---------- code_block.designscript (2 lines) ----------
//String Input Req
"Run";
# ----------------------------------------
Reset = Input(Reset: bool=false)
python_script = Python(IN[0]=code_block, IN[1]=Reset)
# ---------- python_script.python (34 lines) ----------
import clr
clr.AddReference('ProtoGeometry')
from Autodesk.DesignScript.Geometry import *

clr.AddReference("RevitAPIUI")
from  Autodesk.Revit.UI import TaskDialog

clr.AddReference('RevitAPI')
from Autodesk.Revit.DB.Events import *

clr.AddReference("RevitServices")
import RevitServices
from RevitServices.Persistence import DocumentManager
doc = DocumentManager.Instance.CurrentDBDocument
uidoc=DocumentManager.Instance.CurrentUIApplication.ActiveUIDocument

x=True
dypoint=[]
rpoint=[]
counter=0
msg = 'Pick Points on current Workplane in order, hit ESC when finished.'

TaskDialog.Show("Sastrugi", msg)

while x == True:
	try:
		pt=uidoc.Selection.PickPoint(UnwrapElement(IN[0]))
		rp=Point.ByCoordinates(pt.X*304.8,pt.Y*304.8,pt.Z*304.8)
		counter=+1
		dypoint.append(pt)
		rpoint.append(rp)
	except:
		x=False
OUT=(dypoint,rpoint)
# ----------------------------------------
code_block_2 = CodeBlock(a=python_script) { a[0]; a[1]; }
DynamoPoints = Output(code_block_2.out0)
RevitPoints = Output(code_block_2.out1)
