# Dynamo custom node __Pointcloud Get Transform and Scale.dyf "❄_Pointcloud Get Transform and Scale" (Dynamo 1.3.4.6666)
# category: Sastrugi.Pointcloud.Geometry
# (Sastrugi_Pointcloud_Geometry) This node returns the Transform Origin/Vectors and Scale of a Pointcloud Instance.

PointcloudInstance = Input()
elementType = Element.ElementType(PointcloudInstance)
code_block = CodeBlock { "Scale"; }
getParameterValueByName = Element.GetParameterValueByName(element=elementType, parameterName=code_block)
code_block_2 = CodeBlock(list=getParameterValueByName) { Flatten({list}); }
Scale = Output(code_block_2)
python_script = Python(IN[0]=PointcloudInstance)
# ---------- python_script.python (53 lines) ----------
# Python coding credit to Dynamo Forum user - @Ewan_Opie 2019
# Sastrugi Package https://sites.google.com/view/sastrugi/home

import clr
clr.AddReference("RevitNodes")
import Revit
clr.ImportExtensions(Revit.Elements)

clr.AddReference("RevitServices")
import RevitServices
from RevitServices.Persistence import DocumentManager
from RevitServices.Transactions import TransactionManager

from System.Collections.Generic import *

clr.AddReference("RevitAPI")
import Autodesk
from Autodesk.Revit.DB import *

clr.ImportExtensions(Revit.GeometryConversion)

doc = DocumentManager.Instance.CurrentDBDocument
uiapp = DocumentManager.Instance.CurrentUIApplication
app = uiapp.Application

def tolist(obj1):
	if hasattr(obj1,"__iter__"): return obj1
	else: return [obj1]	
	
cloud = tolist(UnwrapElement(IN[0]))

TransactionManager.Instance.EnsureInTransaction(doc)

Ori = []
OvX = []
OvY = []
OvZ = []

for c in cloud:
	ct = []
	tF = c.GetTotalTransform()
	oR = tF.Origin.ToPoint()
	xV = tF.BasisX.ToVector()
	yV = tF.BasisY.ToVector()
	zV = tF.BasisZ.ToVector()
	Ori.append(oR)
	OvX.append(xV)
	OvY.append(yV)
	OvZ.append(zV)
		
TransactionManager.Instance.TransactionTaskDone()

OUT = Ori,OvX,OvY,OvZ
# ----------------------------------------
code_block_3 = CodeBlock(OUT=python_script) { OUT[0]; OUT[1]; OUT[2]; OUT[3]; }
Origin = Output(code_block_3.out0)
X_Axis = Output(code_block_3.out1)  # "X-Axis"
Y_Axis = Output(code_block_3.out2)  # "Y-Axis"
Z_Axis = Output(code_block_3.out3)  # "Z-Axis"
