# Dynamo custom node __Pointcloud RANSAC Plane Detection.dyf "❄_Pointcloud RANSAC Plane Detection" (Dynamo 1.3.4.6666)
# category: Sastrugi.Pointcloud.Geometry
# (Sastrugi_Pointcloud_Geometry) This node uses Random sample consensus (RANSAC) to determine planes within Pointclouds and groups point-sets based on these planes.

Points = Input()
Iterations = Input(Iterations:int=3)  # The number of times a random selection of 3-points is made to generate planes for finding the best point-sets. Generally higher numbers increase accuracy. This process continues until point-sets cannot be created.
Distance = Input(Distance:var=50)  # The assessment corridor width to consider when finding planes to identify point-sets.
code_block = CodeBlock(dist=Distance) { dist/2; }
python_script = Python(IN[0]=Points, IN[1]=Iterations, IN[2]=code_block)
# ---------- python_script.python (88 lines) ----------
# Python coding credit to Dynamo Forum user - @Ewan_Opie 2019
# Sastrugi Package https://sites.google.com/view/sastrugi/home

import clr

clr.AddReference('ProtoGeometry')
from Autodesk.DesignScript.Geometry import *

from System.Collections.Generic import *

clr.AddReference('DSCoreNodes') 
import DSCore
from DSCore import *

import sys
sys.path.append('C:\Program Files (x86)\IronPython 2.7\Lib')
import random

def tolist(obj1):
	if hasattr(obj1,"__iter__"): return obj1
	else: return [obj1]

def diff(list1, list2):
    c = set(list1).union(set(list2))
    d = set(list1).intersection(set(list2)) 
    return list(c - d)
 
def ransac(plist,iter,dist):
	PLfinal = []
	PTfinal = []
	Cfinal = []
	PTind1 = []
	PTind2 = []
	PL1 = []
	pIn1 = []
	OutCount= 0
	run = DSCore.List.Flatten(DSCore.List.OfRepeatedItem("Token",iter),1)
	for r in run:
		pg1 = random.sample(plist,3)
		pl1 = Plane.ByBestFitThroughPoints(pg1)
		PL1.append(pl1)
		for pl in PL1:
			pIn= []
			for p in plist:
				gd = Geometry.DistanceTo(pl,p)
				if gd<dist:
					pIn.append(p)
				else:
					OutCount+1
		pIn1.append(pIn)
		fitcount = []
		for pp in pIn1:
			c = DSCore.List.Count(pp)
			fitcount.append(c)
			max = DSCore.List.MaximumItem(fitcount)
			index = DSCore.List.FirstIndexOf(fitcount,max)
	PLf = DSCore.List.GetItemAtIndex(PL1,index) 
	PTf = DSCore.List.GetItemAtIndex(pIn1,index)
	Cf = DSCore.List.GetItemAtIndex(fitcount,index)
	PLfinal.append(PLf)
	PTfinal.append(PTf)
	Cfinal.append(Cf)
	PTfinalflat = DSCore.List.Flatten(PTfinal,1)
	newpoints = diff(tolist(plist),PTfinalflat)
	plist=newpoints
	return plist,PTfinalflat
	
plist = IN[0]
iter=IN[1]
dist = IN[2]

result = []
result2 = []

check = DSCore.List.Flatten(DSCore.List.OfRepeatedItem("Token",iter),1)

for c in check:
	if len(plist)>3:
		itest = ransac(plist,iter,dist)
		outP = DSCore.List.GetItemAtIndex(itest,0)
		inP = DSCore.List.GetItemAtIndex(itest,1)
		result.append(inP)
		plist[:] = outP
	else:
		pass
result2.append(result)

OUT = result2
# ----------------------------------------
code_block_2 = CodeBlock { 1; }
flatten = List.Flatten(list=python_script, amt=code_block_2)
count = Count(flatten@L2)
Threshold = Input(Threshold:var=0)  # Point-sets (identified Planes) with point numbers above this value will be returned.
code_block_3 = CodeBlock(number1=count, number2=Threshold)
# ---------- code_block_3.designscript (3 lines) ----------
number1>=number2?
true:
false;
# ----------------------------------------
filterByBoolMask = List.FilterByBoolMask(list=flatten, mask=code_block_3)
byBestFitThroughPoints = Plane.ByBestFitThroughPoints(filterByBoolMask.in)
Planes = Output(byBestFitThroughPoints)
PointSets = Output(filterByBoolMask.in)
