# Dynamo custom node __Pointcloud Sample Pointcloud.dyf "❄_Pointcloud Sample Pointcloud" (Dynamo 1.3.4.6666)
# category: Sastrugi.Pointcloud.Geometry
# (Sastrugi_Pointcloud_Geometry) This node takes a sample of random points from a Pointcloud Instance.

Refresh = Input(Refresh:bool=true)
python_script = Python(IN[0]=Refresh)
# ---------- python_script.python (40 lines) ----------
import clr

clr.AddReference("RevitAPIUI")
from  Autodesk.Revit.UI import *

clr.AddReference("RevitServices")
import RevitServices
from RevitServices.Persistence import DocumentManager
doc = DocumentManager.Instance.CurrentDBDocument
uidoc=DocumentManager.Instance.CurrentUIApplication.ActiveUIDocument

clr.AddReference("RevitNodes")
import Revit
clr.ImportExtensions(Revit.Elements)

def flatten(*args):
    for x in args:
        if hasattr(x, '__iter__'):
            for y in flatten(*x):
                yield y
        else:
            yield x

sel1 = uidoc.Selection
ot1 = Selection.ObjectType.Element
msg = 'Pick PointCloud in Active View.'
TaskDialog.Show("Sastrugi", msg)
el_refs = sel1.PickObject(ot1, "Select")
typelist = list()
idlist = list()
el_ref = flatten(el_refs)
for i in el_ref:

	try:
		typelist.append(doc.GetElement(i.ElementId))
	except:
		typelist.apped(list())
		

OUT = typelist[-1]
# ----------------------------------------
code_block = CodeBlock(list=python_script) { Flatten({list}); }
firstItem = List.FirstItem(code_block)
boundingBox = Element.BoundingBox(python_script)
toCuboid = BoundingBox.ToCuboid(boundingBox)
centroid = Solid.Centroid(toCuboid)
ZAxis = Vector.ZAxis()
byOriginNormal = Plane.ByOriginNormal(origin=centroid, normal=ZAxis)
code_block_2 = CodeBlock { 1.01; }
scale = Geometry.Scale(toCuboid, byOriginNormal, code_block_2, code_block_2, code_block_2)
faces = Element.Faces(scale)
vertices = Topology.Vertices(faces)
pointGeometry = Vertex.PointGeometry(vertices)
byBestFitThroughPoints = Plane.ByBestFitThroughPoints(pointGeometry)
origin = Plane.Origin(byBestFitThroughPoints)
centroid_2 = Solid.Centroid(toCuboid)
byTwoPoints = Vector.ByTwoPoints(start=origin, end=centroid_2, lacing=Longest)
byOriginNormal_2 = Plane.ByOriginNormal(origin=origin, normal=byTwoPoints)
code_block_3 = CodeBlock { 0.001; }
PointSampleSize = Input(PointSampleSize: int = 1000)  # This is the number of points to take from within the Pointcloud.
python_script_2 = Python(IN[0]=firstItem, IN[1]=byOriginNormal_2, IN[2]=code_block_3, IN[3]=PointSampleSize)
# ---------- python_script_2.python (45 lines) ----------
import clr
clr.AddReference('ProtoGeometry')
from Autodesk.DesignScript.Geometry import *

clr.AddReference("RevitNodes")
import Revit
clr.ImportExtensions(Revit.Elements)

clr.ImportExtensions(Revit.GeometryConversion)

clr.AddReference("RevitServices")
import RevitServices
from RevitServices.Persistence import DocumentManager
from RevitServices.Transactions import TransactionManager
from System.Collections.Generic import *

clr.AddReference("RevitAPI")
import Autodesk
from Autodesk.Revit.DB import *
from Autodesk.Revit.DB.PointClouds import *

doc = DocumentManager.Instance.CurrentDBDocument
uiapp = DocumentManager.Instance.CurrentUIApplication
app = uiapp.Application
uidoc=DocumentManager.Instance.CurrentUIApplication.ActiveUIDocument

PL=[]
for i in IN[1]:
	PL.append(UnwrapElement(i).ToPlane())

IPL=List[Autodesk.Revit.DB.Plane](PL)
PLfilter=PointCloudFilterFactory.CreateMultiPlaneFilter(PL)

dist = IN[2]
sample= IN[3]

points = UnwrapElement(IN[0]).GetPoints(PLfilter, dist, sample)
pointsample=[]
for p in points:
	X=p.X
	Y=p.Y
	Z=p.Z
	pointsample.append(Point.Create(XYZ(X,Y,Z)).ToProtoType(True))

OUT = pointsample
# ----------------------------------------
code_block_4 = CodeBlock(list=python_script_2) { Flatten({list}); }

# group: Adjust Selected Points by Transform
elementType = Element.ElementType(python_script)
code_block_5 = CodeBlock { "Scale"; }
getParameterValueByName = Element.GetParameterValueByName(element=elementType, parameterName=code_block_5)
scale_2 = Geometry.Scale(geometry=code_block_4, xamount=getParameterValueByName, yamount=getParameterValueByName, zamount=getParameterValueByName)
identity = CoordinateSystem.Identity()
python_script_3 = Python(IN[0]=code_block)
# ---------- python_script_3.python (45 lines) ----------
#BIG THANKS TO @AWILLIAMS
import clr
clr.AddReference('ProtoGeometry')
from Autodesk.DesignScript.Geometry import *

clr.AddReference("RevitNodes")
import Revit
clr.ImportExtensions(Revit.Elements)

clr.AddReference("RevitServices")
import RevitServices
from RevitServices.Persistence import DocumentManager
from RevitServices.Transactions import TransactionManager

from System.Collections.Generic import *

clr.AddReference("RevitAPI")
import Autodesk
from Autodesk.Revit.DB import *

clr.ImportExtensions(Revit.GeometryConversion)

doc = DocumentManager.Instance.CurrentDBDocument
uiapp = DocumentManager.Instance.CurrentUIApplication
app = uiapp.Application


cloud = UnwrapElement(IN[0])

TransactionManager.Instance.EnsureInTransaction(doc)


cloudtransform = []

for c in cloud:
	transform = c.GetTotalTransform()
	X = transform.Origin.X
	Y = transform.Origin.Y
	Z = transform.Origin.Z
	point=Point.Create(XYZ(X,Y,Z)).ToProtoType(True)
	cloudtransform.append(point)
	
TransactionManager.Instance.TransactionTaskDone()

OUT = cloudtransform
# ----------------------------------------
ZAxis_2 = Vector.ZAxis()
byOriginNormal_3 = Plane.ByOriginNormal(origin=python_script_3, normal=ZAxis_2)
byPlane = CoordinateSystem.ByPlane(byOriginNormal_3)
transform = Geometry.Transform(geometry=scale_2, fromCoordinateSystem=identity, contextCoordinateSystem=byPlane, lacing=Longest)
code_block_6 = CodeBlock(list=transform) { Flatten({list}); }
Points = Output(code_block_6)
