# Dynamo custom node __Pointcloud Select Points in View.dyf "❄_Pointcloud Select Points in View" (Dynamo 1.3.4.6666)
# category: Sastrugi.Pointcloud.Geometry
# (Sastrugi_Pointcloud_Geometry) This node allows users to select a specific number of Pointcloud Points by creating a selection region in the Active View.

boolean = BoolSelector(true)
python_script = Python(IN[0]=boolean)
# ---------- python_script.python (11 lines) ----------
import clr

clr.AddReference("RevitServices")
import RevitServices
from RevitServices.Persistence import DocumentManager
doc = DocumentManager.Instance.CurrentDBDocument
clr.AddReference("RevitNodes")
import Revit
clr.ImportExtensions(Revit.Elements)

OUT = doc.ActiveView.ToDSType(True)
# ----------------------------------------
firstItem = List.FirstItem(python_script)
python_script_2 = Python(IN[0]=boolean, IN[1]=firstItem)
# ---------- python_script_2.python (51 lines) ----------
# Python coding credit to Dynamo Forum user - @Ewan_Opie 2019
# Sastrugi Package https://sites.google.com/view/sastrugi/home

import clr
clr.AddReference('RevitAPI')
import Autodesk
from Autodesk.Revit.DB import *

clr.AddReference("RevitServices")
import RevitServices
from RevitServices.Persistence import DocumentManager

clr.AddReference("RevitAPIUI")
from  Autodesk.Revit.UI import *

clr.AddReference('ProtoGeometry')
from Autodesk.DesignScript.Geometry import *

clr.AddReference('DSCoreNodes') 
import DSCore
from DSCore import *

clr.AddReference("RevitNodes")
import Revit
clr.ImportExtensions(Revit.GeometryConversion)

doc = DocumentManager.Instance.CurrentDBDocument
uidoc=DocumentManager.Instance.CurrentUIApplication.ActiveUIDocument

buttonlist = TaskDialogCommonButtons.Ok
TaskDialog.Show("Sastrugi","Please select a region, bottom left to top right.",buttonlist)

pboxS=Autodesk.Revit.UI.Selection.PickBoxStyle.Enclosing
pickedBox = uidoc.Selection.PickBox(pboxS, "Select a box")
minP = UnwrapElement(pickedBox.Min)
maxP = UnwrapElement(pickedBox.Max)
p1=Point.ByCoordinates(minP.X*304.8,minP.Y*304.8,minP.Z*304.8)
p2=Point.ByCoordinates(maxP.X*304.8,maxP.Y*304.8,maxP.Z*304.8)

aView = UnwrapElement(IN[1])

aVO = aView.Origin.ToPoint()
aVD = aView.ViewDirection.ToVector()
aVP = Plane.ByOriginNormal(aVO,aVD)

rL = Line.ByStartPointEndPoint(p1,p2)
rLaVP = Curve.PullOntoPlane(rL,aVP)

newO = Curve.PointAtParameter(rLaVP,0.5)

OUT = aVP,rLaVP,newO,aView
# ----------------------------------------
code_block = CodeBlock(out=python_script_2) { out[0]; out[1]; out[2]; out[3]; }
ZAxis = Vector.ZAxis()
code_block_2 = CodeBlock { 1000; }
translate = Geometry.Translate(geometry=code_block.out2, direction=ZAxis, distance=code_block_2)
normal = Plane.Normal(code_block.out0)
translate_2 = Geometry.Translate(geometry=code_block.out2, direction=normal, distance=code_block_2)
byThreePoints = Plane.ByThreePoints(code_block.out2, translate, translate_2)
YAxis = Plane.YAxis(code_block.out0)
byOriginNormal = Plane.ByOriginNormal(origin=code_block.out2, normal=YAxis)
code_block_3 = CodeBlock(planecheck=byThreePoints, usethisone=byOriginNormal, usetheotherone=byThreePoints)
# ---------- code_block_3.designscript (3 lines) ----------
planecheck==null?
usethisone:
usetheotherone;
# ----------------------------------------
mirror = Geometry.Mirror(geometry=code_block.out1, mirrorPlane=code_block_3)
code_block_4 = CodeBlock { 0..1; }
pointAtParameter = Curve.PointAtParameter(curve=mirror, param=code_block_4)
pointAtParameter_2 = Curve.PointAtParameter(curve=code_block.out1, param=code_block_4)
create = List.Create(pointAtParameter, pointAtParameter_2)
transpose = List.Transpose(create)
flatten = Flatten(transpose)
byCornerPoints = Rectangle.ByCornerPoints(flatten)
reverse = Vector.Reverse(normal)
code_block_5 = CodeBlock { 1000000; }
translate_3 = Geometry.Translate(geometry=byCornerPoints, direction=reverse, distance=code_block_5)
points = Polygon.Points(translate_3)
deconstruct = List.Deconstruct(list=points)
create_2 = List.Create(deconstruct.rest, deconstruct.first)
flatten_2 = Flatten(create_2)
translate_4 = Geometry.Translate(geometry=byCornerPoints, direction=normal, distance=code_block_5)
points_2 = Polygon.Points(translate_4)
create_3 = List.Create(points, points_2)
transpose_2 = List.Transpose(create_3)
addItemToEnd = List.AddItemToEnd(item=flatten_2@L1, list=transpose_2@L2)
byBestFitThroughPoints = Plane.ByBestFitThroughPoints(addItemToEnd)
code_block_6 = CodeBlock(passthrough=boolean, waitfor=byBestFitThroughPoints) { {passthrough,waitfor}[0]; }
python_script_3 = Python(IN[0]=code_block_6)
# ---------- python_script_3.python (40 lines) ----------
import clr

clr.AddReference("RevitAPIUI")
from  Autodesk.Revit.UI import *

clr.AddReference("RevitServices")
import RevitServices
from RevitServices.Persistence import DocumentManager
doc = DocumentManager.Instance.CurrentDBDocument
uidoc=DocumentManager.Instance.CurrentUIApplication.ActiveUIDocument

clr.AddReference("RevitNodes")
import Revit
clr.ImportExtensions(Revit.Elements)

def flatten(*args):
    for x in args:
        if hasattr(x, '__iter__'):
            for y in flatten(*x):
                yield y
        else:
            yield x

sel1 = uidoc.Selection
ot1 = Selection.ObjectType.Element
msg = 'Pick PointCloud in Active View.'
TaskDialog.Show("Sastrugi", msg)
el_refs = sel1.PickObject(ot1, "Select")
typelist = list()
idlist = list()
el_ref = flatten(el_refs)
for i in el_ref:

	try:
		typelist.append(doc.GetElement(i.ElementId))
	except:
		typelist.apped(list())
		

OUT = typelist[-1]
# ----------------------------------------
code_block_7 = CodeBlock(list=python_script_3) { Flatten({list}); }
firstItem_2 = List.FirstItem(code_block_7)
code_block_8 = CodeBlock { 0.001; }
PointSampleSize = Input(PointSampleSize: int = 1000)  # This is the number of points to take from within the selected region. Please note that the actual number of Points output may vary from this number if a Sectionbox has been used.
python_script_4 = Python(IN[0]=firstItem_2, IN[1]=byBestFitThroughPoints, IN[2]=code_block_8, IN[3]=PointSampleSize)
# ---------- python_script_4.python (46 lines) ----------
import clr
clr.AddReference('ProtoGeometry')
from Autodesk.DesignScript.Geometry import *

clr.AddReference("RevitNodes")
import Revit
clr.ImportExtensions(Revit.Elements)

clr.ImportExtensions(Revit.GeometryConversion)

clr.AddReference("RevitServices")
import RevitServices
from RevitServices.Persistence import DocumentManager
from RevitServices.Transactions import TransactionManager
from System.Collections.Generic import *

clr.AddReference("RevitAPI")
import Autodesk
from Autodesk.Revit.DB import *
from Autodesk.Revit.DB.PointClouds import *


doc = DocumentManager.Instance.CurrentDBDocument
uiapp = DocumentManager.Instance.CurrentUIApplication
app = uiapp.Application
uidoc=DocumentManager.Instance.CurrentUIApplication.ActiveUIDocument

planes=[]
for i in IN[1]:
	planes.append(UnwrapElement(i).ToPlane())
Iplanes=List[Autodesk.Revit.DB.Plane](planes)

pcf=PointCloudFilterFactory.CreateMultiPlaneFilter(planes)

averageDistance = IN[2]
numberOfPoints= IN[3]

points = UnwrapElement(IN[0]).GetPoints(pcf, averageDistance, numberOfPoints)
elements=[]
for p in points:
	X=p.X
	Y=p.Y
	Z=p.Z
	elements.append(Point.Create(XYZ(X,Y,Z)).ToProtoType(True))

OUT = elements
# ----------------------------------------
code_block_9 = CodeBlock(list=python_script_4) { Flatten({list}); }

# group: Adjust Selected Points by Transform and Section Box Containment (CREDIT TO @Awilliams for Boundingbox code)
elementType = Element.ElementType(python_script_3)
code_block_10 = CodeBlock { "Scale"; }
getParameterValueByName = Element.GetParameterValueByName(element=elementType, parameterName=code_block_10)
scale = Geometry.Scale(geometry=code_block_9, xamount=getParameterValueByName, yamount=getParameterValueByName, zamount=getParameterValueByName)
identity = CoordinateSystem.Identity()
python_script_5 = Python(IN[0]=code_block_7)
# ---------- python_script_5.python (46 lines) ----------
#BIG THANKS TO @AWILLIAMS

import clr
clr.AddReference('ProtoGeometry')
from Autodesk.DesignScript.Geometry import *

clr.AddReference("RevitNodes")
import Revit
clr.ImportExtensions(Revit.Elements)

clr.AddReference("RevitServices")
import RevitServices
from RevitServices.Persistence import DocumentManager
from RevitServices.Transactions import TransactionManager

from System.Collections.Generic import *

clr.AddReference("RevitAPI")
import Autodesk
from Autodesk.Revit.DB import *

clr.ImportExtensions(Revit.GeometryConversion)

doc = DocumentManager.Instance.CurrentDBDocument
uiapp = DocumentManager.Instance.CurrentUIApplication
app = uiapp.Application


cloud = UnwrapElement(IN[0])

TransactionManager.Instance.EnsureInTransaction(doc)


cloudtransform = []

for c in cloud:
	transform = c.GetTotalTransform()
	X = transform.Origin.X
	Y = transform.Origin.Y
	Z = transform.Origin.Z
	point=Point.Create(XYZ(X,Y,Z)).ToProtoType(True)
	cloudtransform.append(point)
	
TransactionManager.Instance.TransactionTaskDone()

OUT = cloudtransform
# ----------------------------------------
ZAxis_2 = Vector.ZAxis()
byOriginNormal_2 = Plane.ByOriginNormal(origin=python_script_5, normal=ZAxis_2)
byPlane = CoordinateSystem.ByPlane(byOriginNormal_2)
transform = Geometry.Transform(geometry=scale, fromCoordinateSystem=identity, contextCoordinateSystem=byPlane, lacing=Longest)
python_script_6 = Python(IN[0]=boolean)  # same code as python_script
code_block_11 = CodeBlock(list=python_script_6) { Flatten({list}); }
python_script_7 = Python(IN[0]=code_block_11)
# ---------- python_script_7.python (55 lines) ----------
#BIG THANKS TO @AWILLIAMS

import clr
clr.AddReference('ProtoGeometry')
from Autodesk.DesignScript.Geometry import *

clr.AddReference("RevitNodes")
import Revit
clr.ImportExtensions(Revit.Elements)

clr.AddReference("RevitServices")
import RevitServices
from RevitServices.Persistence import DocumentManager
from RevitServices.Transactions import TransactionManager

from System.Collections.Generic import *

clr.AddReference("RevitAPI")
import Autodesk
from Autodesk.Revit.DB import *

clr.ImportExtensions(Revit.GeometryConversion)

doc = DocumentManager.Instance.CurrentDBDocument
uiapp = DocumentManager.Instance.CurrentUIApplication
app = uiapp.Application


views = UnwrapElement(IN[0])

TransactionManager.Instance.EnsureInTransaction(doc)

sectionboxes = []

for view in views:
	sectionbox = view.GetSectionBox()
	transform = sectionbox.Transform
	sboxoriginx = transform.Origin.X
	sboxoriginy = transform.Origin.Y
	sboxoriginz = transform.Origin.Z
	minx = sectionbox.Min.X + sboxoriginx
	maxx = sectionbox.Max.X + sboxoriginx
	miny = sectionbox.Min.Y + sboxoriginy
	maxy = sectionbox.Max.Y + sboxoriginy
	minz = sectionbox.Min.Z + sboxoriginz
	maxz = sectionbox.Max.Z + sboxoriginz
	bbox = BoundingBoxXYZ()
	bbox.Min = XYZ((minx), (miny), (minz))
	bbox.Max = XYZ((maxx), (maxy), (maxz))
	tsectionbox = bbox.ToProtoType()
	sectionboxes.append(tsectionbox)
	
TransactionManager.Instance.TransactionTaskDone()

OUT = sectionboxes
# ----------------------------------------
contains = BoundingBox.Contains(python_script_7, transform, lacing=Longest)
filterByBoolMask = List.FilterByBoolMask(list=transform, mask=contains)
code_block_12 = CodeBlock { "Section Box"; }
getParameterValueByName_2 = Element.GetParameterValueByName(element=python_script_6, parameterName=code_block_12)
code_block_13 = CodeBlock(section=getParameterValueByName_2) { section==0; }
code_block_14 = CodeBlock(filterByBoolMask.out, filterByBoolMask.in, code_block_13) { result[0] = trueval; result[1] = falseval; result[test ? 0 : 1]; }
code_block_15 = CodeBlock(list=code_block_14.out2) { Flatten({list}); }
byBestFitThroughPoints_2 = Plane.ByBestFitThroughPoints(code_block_15)
BestFitPlane = Output(byBestFitThroughPoints_2)
Points = Output(code_block_15)

Refresh = Input(Refresh:bool=false)
