# Dynamo custom node __Pointcloud_Column_From_Points.dyf "❄_Pointcloud Column From Points" (Dynamo 2.6.1.8786)
# category: Sastrugi.Pointcloud.Geometry
# (Sastrugi_Pointcloud_Geometry) This node calculates the shape and parameters for a column by assessing the layout of input points.

# group: Format Input Points
InputPoints = Input(InputPoints: var[]..[])
code_block = CodeBlock(InputPoints=InputPoints) { InputPoints; }
py_avgpt = Python(IN[0]=code_block)
# ---------- py_avgpt.python (22 lines) ----------
# Load the Python Standard and DesignScript Libraries
import sys
import clr
clr.AddReference('ProtoGeometry')
from Autodesk.DesignScript.Geometry import *

## Get average point of list of points
def avgPt(pts):
	# Centroid
	ptX = []
	ptY = []
	ptZ = []
	for p in pts:
		ptX.append(p.X)
		ptY.append(p.Y)
		ptZ.append(p.Z)
	avgX = sum(ptX) / len(ptX)
	avgY = sum(ptY) / len(ptY)
	avgZ = sum(ptZ) / len(ptZ)
	return Point.ByCoordinates(avgX,avgY,avgZ)
	
OUT = avgPt(IN[0])
# ----------------------------------------
code_block_2 = CodeBlock { Vector.ZAxis(); }
byOriginNormal = Plane.ByOriginNormal(origin=py_avgpt, normal=code_block_2)
closestPointTo = Geometry.ClosestPointTo(geometry=byOriginNormal, other=code_block)
code_block_3 = CodeBlock { 1; }
pruneDuplicates = Point.PruneDuplicates(points=closestPointTo, tolerance=code_block_3)
code_block_4 = CodeBlock(point=py_avgpt) { point.Z; }

# group: Calc Basic Shapes
py_fitrectangle = Python(IN[0]=pruneDuplicates, IN[1]=code_block_4)
# ---------- py_fitrectangle.python (149 lines) ----------
# Python coding credit to Dynamo Forum user - @Ewan_Opie 2019
# Sastrugi Package https://sites.google.com/view/sastrugi/home

import clr
clr.AddReference('RevitAPI')
import Autodesk
from Autodesk.Revit.DB import *

clr.AddReference("RevitServices")
import RevitServices
from RevitServices.Persistence import DocumentManager
from RevitServices.Transactions import TransactionManager

clr.AddReference("RevitAPIUI")
from  Autodesk.Revit.UI import *

doc = DocumentManager.Instance.CurrentDBDocument

clr.AddReference("RevitNodes")
import Revit
clr.ImportExtensions(Revit.GeometryConversion)

clr.AddReference('ProtoGeometry')
from Autodesk.DesignScript.Geometry import *

from System.Collections.Generic import *

clr.AddReference('DSCoreNodes') 
import DSCore
from DSCore import *

from math import sqrt
from operator import itemgetter

def flatten(lst):
	return DSCore.List.Flatten(lst,2)
	
## Convert an instance/list to a list
def tolist(obj1):
	if hasattr(obj1,"__iter__"): return obj1
	else: return [obj1]

#def alignedBBox(input_elements),clearance_offset):

def hull(_pts):
	def pCrs(o, a, b):
		return (a[0] - o[0]) * (b[1] - o[1]) - (a[1] - o[1]) * (b[0] - o[0])
	
	pts = sorted( (p.X, p.Y) for p in _pts)
	pLen = len(pts)
	if pLen < 4 : return pts
	else:
		lower, upper = [], []
			
		for i in xrange(pLen):
			j = pLen - 1 - i
			while len(lower) >= 2 and pCrs(lower[-2], lower[-1], pts[i]) <= 0.000001:
				lower.pop()
			lower.append(pts[i])
			while len(upper) >= 2 and pCrs(upper[-2], upper[-1], pts[j]) <= 0.000001:
				upper.pop()
			upper.append(pts[j])
			
		lower.pop()
		upper.pop()
		lower.extend(upper)
		return lower
	
def scalar(k, i, j):
	return k[0] * (i[1] - j[1]) + k[1] * (j[0] - i[0]) + j[1] * i[0] - i[1] * j[0]
	
def pDist(a, b, sqrt=sqrt):
	return sqrt( (a[0] - b[0])**2 + (a[1] - b[1])**2)
	
def linDist(a, b, p):
	line_dist = pDist(a, b)
	if line_dist == 0:
		return a, pDist(p, a)
		
	t = ( (p[0] - a[0]) * (b[0] - a[0]) + (p[1] - a[1]) * (b[1] - a[1]) ) / line_dist**2
		
	cp = ( (b[0] - a[0]) * t + a[0], (b[1] - a[1]) * t + a[1])
	d1 = pDist(p, cp)
	return cp, d1
	
def indexer(end, position=0, start=0, step=1):
	i = position - step
	while True:
		i += step
		if i >= end:
			i = start
		yield i
	
def highSearch(pts, iPt, jPt, j, it1=None, k=None, m=None,
				   indexer=indexer, scalar=scalar):
	if it1 is None:
		it1 = indexer(len(pts), j)
		k, m = it1.next(), it1.next()
	Sa = scalar(pts[k], iPt, jPt)
	Sb = scalar(pts[m], iPt, jPt)
	while Sa < Sb:
		k, m = m, it1.next()
		Sa = scalar(pts[k], iPt, jPt)
		Sb = scalar(pts[m], iPt, jPt)
	return k, m
		
pts = hull(IN[0])
el = IN[1]	
highPts, closePts, areas, dists = [], [], [], []
lnPts = len(pts)
	
it1 = indexer(lnPts, 2)
k, m = it1.next(), it1.next()

for i in xrange(lnPts):
	j = (i + 1) % lnPts
			
	k, m = highSearch(pts, pts[i], pts[j], j+1, it1, k, m)
				
	highPts.append(pts[k])
	cp, l1 = linDist(pts[i], pts[j], pts[k])
	closePts.append(cp)
			
	n, _ = highSearch(pts, pts[k], cp, j)
	_, l2a = linDist(pts[k], cp, pts[n])
					
	q, _ = highSearch(pts, cp, pts[k], m)
	_, l2b = linDist(cp, pts[k], pts[q])
				
	areas.append(l1 * (l2a + l2b) )
	dists.append( (l2a, l2b) )
		
ix, _ = min(enumerate(areas), key=itemgetter(1) )
d1, d2 = dists[ix]
_a, _b = closePts[ix], highPts[ix]
a = Point.ByCoordinates(_a[0], _a[1], el)
b = Point.ByCoordinates(_b[0], _b[1], el)

_v = Vector.ByTwoPoints(a, b)
v = Vector.ByCoordinates(-_v.Y, _v.X, 0).Normalized()
p1 = a.Add(v.Scale(d2) )
p2 = a.Subtract(v.Scale(d1) )
p3 = b.Subtract(v.Scale(d1) )
p4 = b.Add(v.Scale(d2) )
		
Rect = Rectangle.ByCornerPoints(p1, p2, p3, p4)

OUT = Rect	
			
# ----------------------------------------
byBestFitThroughPoints = Circle.ByBestFitThroughPoints(points=pruneDuplicates)

# group: Check for Internal Points
width = Rectangle.Width(rectangle=py_fitrectangle)
height = Rectangle.Height(rectangle=py_fitrectangle)
code_block_5 = CodeBlock(w=width, h=height)
# ---------- code_block_5.designscript (3 lines) ----------
w<h?
w:
h;
# ----------------------------------------
code_block_6 = CodeBlock()
# ---------- code_block_6.designscript (2 lines) ----------
//Internal Point Tolerance %
0.50;
# ----------------------------------------
code_block_7 = CodeBlock(small=code_block_5, ratio=code_block_6) { 0-(small-(small*ratio)); }
offset = Curve.Offset(curve=byBestFitThroughPoints, distance=code_block_7)
code_block_8 = CodeBlock { 5; }
regularPolygon = Polygon.RegularPolygon(circle=offset, numberSides=code_block_8)
containmentTest = Polygon.ContainmentTest(polygon=regularPolygon, point=pruneDuplicates)
countTrue = List.CountTrue(list=containmentTest)
code_block_9 = CodeBlock(count=countTrue)
# ---------- code_block_9.designscript (3 lines) ----------
count>0?
true:
false;
# ----------------------------------------
code_block_10 = CodeBlock(check=code_block_9)
# ---------- code_block_10.designscript (3 lines) ----------
check?
"Section":
"Solid";
# ----------------------------------------

# group: Check Sides with Points
py_checkrectsidepts = Python(IN[0]=py_fitrectangle, IN[1]=pruneDuplicates)
# ---------- py_checkrectsidepts.python (30 lines) ----------
# Python coding credit to Dynamo Forum user - @Ewan_Opie 2019
# Sastrugi Package https://sites.google.com/view/sastrugi/home

import sys
import clr
clr.AddReference('ProtoGeometry')
from Autodesk.DesignScript.Geometry import *

rect = IN[0]
pts = IN[1]

polys = []

r_curves = PolyCurve.Curves(rect)
for r in r_curves:
	bpt = Curve.PointAtParameter(r,0.5)
	bpl = Plane.ByOriginNormal(bpt,Vector.ZAxis())
	ci = Circle.ByPlaneRadius(bpl,25)
	po = Polygon.RegularPolygon(ci)
	polys.append(po)
	
check = 0
for poly in polys:
	count = 0
	for pt in pts:
		if Polygon.ContainmentTest(poly,pt):
			count += 1
	if count > 0:
		check +=1
OUT = check
# ----------------------------------------

# group: Calc Column Shapes
curves = PolyCurve.Curves(polyCurve=py_fitrectangle)
code_block_11 = CodeBlock { 0.5; }
pointAtParameter = Curve.PointAtParameter(curve=curves, param=code_block_11)
byStartPointEndPoint = Line.ByStartPointEndPoint(startPoint=py_avgpt, endPoint=pointAtParameter)
code_block_12 = CodeBlock()
# ---------- code_block_12.designscript (2 lines) ----------
//Confidence % in outer point uniformity
85;
# ----------------------------------------
code_block_13 = CodeBlock(pts=pruneDuplicates, rect=py_fitrectangle, circle=byBestFitThroughPoints, axisLines=byStartPointEndPoint, confidence=code_block_12, shapeCheck=code_block_10) { pts; rect; circle; axisLines; confidence; shapeCheck; }
py_determine_column_shape = Python(IN[0]=code_block_13.pts, IN[1]=code_block_13.rect, IN[2]=code_block_13.circle, IN[3]=code_block_13.axisLines, IN[4]=code_block_13.confidence, IN[5]=py_checkrectsidepts)
# ---------- py_determine_column_shape.python (120 lines) ----------
# Python coding credit to Dynamo Forum user - @Ewan_Opie 2019
# Sastrugi Package https://sites.google.com/view/sastrugi/home

import sys
import clr
clr.AddReference('ProtoGeometry')
from Autodesk.DesignScript.Geometry import *

def most_common(lst):
    return max(set(lst), key=lst.count)
    
## Remove Duplicates from a List
def removeDuplicates(mylist):
	newlist = list(dict.fromkeys(mylist))
	return newlist   

## Group items in lists by keys
def group(lists, keys):
	uniqueKeys = set(keys)
	results = []
	for uniqueItem in uniqueKeys:
	    keyGroup = []
	    for element, key in zip(lists,keys):
	        if key == uniqueItem:
	            keyGroup.append(element)
	   	results.append(keyGroup)
	return results	

clr.AddReference('DSCoreNodes') 
import DSCore
from DSCore import *

## Get the Indexes of Sorted Values	
def indexbyvalue(data):
	sdata = sorted(data)
	indices = []
	for s in sdata:
		i = data.index(s)
		indices.append(i)
	return indices

def isEdge(line,pts,sample):
	# Create sample polygon
	bp = Curve.PointAtParameter(line,0.5)
	pl = Plane.ByOriginNormal(bp,Vector.ZAxis())
	ci = Circle.ByPlaneRadius(pl,sample/2)
	poly = Polygon.RegularPolygon(ci,5)
	
	# Count pts that occur within the sample, if greater than 0 then line is an edge
	count_pts = 0
	for p in pts:
		if Polygon.ContainmentTest(poly,p):
			count_pts += 1
			
	if count_pts > 0:
		return True
	else:
		return False
		
pts = IN[0]
rect = IN[1]
circ = IN[2]
axisL = IN[3]
conf = IN[4]
sideCheck = IN[5]

tolerance = 10
sample_diameter = 50

result = []

rect_conf = 0
circ_conf = 0

if sideCheck == 4:
	# Workflow for Non Shape
	for p in pts:
		if Geometry.DistanceTo(p,rect) < tolerance:
			rect_conf += 1
		if Geometry.DistanceTo(p,circ) < tolerance:
			circ_conf += 1
	if rect_conf > circ_conf:
		shape_type = "Rectangular"
		OUT = rect,shape_type,rect.Width,rect.Height
	elif circ_conf > rect_conf:
		shape_type = "Circular"
		OUT = circ,shape_type,circ.Radius

else:
	#Workfow for Shape
		
	result = []
	rect_lines = PolyCurve.Curves(rect)
	rect_count = []
	edges = []
	for r in rect_lines:
		if isEdge(r,pts,sample_diameter):
			edges.append(r)
	if len(edges) == 3:
		shape_type = "Channel Section"
		lengths = []
		for e in edges:
			lengths.append(e.Length)
		col_width = min(lengths)
		col_length = max(lengths)
		
	elif len(edges) == 2:
		shape_type = "I Section"
		midpts = []
		for e in edges:
			midpts.append(Curve.PointAtParameter(e,0.5))
		edges.append(Line.ByStartPointEndPoint(midpts[0],midpts[1]))
		col_length = edges[-1].Length
		col_width = edges[0].Length
	else:
		shape_type = "Unknown Section"
		col_width = "Unknown"
		col_length = "Unknown"
		
	OUT = edges, shape_type	,col_width,col_length
# ----------------------------------------

# group: Outputs
center = Polygon.Center(polygon=py_fitrectangle)
py_widthoutput = Python(IN[0]=py_determine_column_shape)
# ---------- py_widthoutput.python (12 lines) ----------
# Load the Python Standard and DesignScript Libraries
import sys
import clr
clr.AddReference('ProtoGeometry')
from Autodesk.DesignScript.Geometry import *

data = IN[0]

if "Circle" not in data[1]:
	OUT = data[2]
else:
	OUT = "Not Applicable"
# ----------------------------------------
py_lengthoutput = Python(IN[0]=py_determine_column_shape)
# ---------- py_lengthoutput.python (12 lines) ----------
# Load the Python Standard and DesignScript Libraries
import sys
import clr
clr.AddReference('ProtoGeometry')
from Autodesk.DesignScript.Geometry import *

data = IN[0]

if "Circle" not in data[1]:
	OUT = data[3]
else:
	OUT = "Not Applicable"
# ----------------------------------------
py_diameteroutput = Python(IN[0]=py_determine_column_shape)
# ---------- py_diameteroutput.python (12 lines) ----------
# Load the Python Standard and DesignScript Libraries
import sys
import clr
clr.AddReference('ProtoGeometry')
from Autodesk.DesignScript.Geometry import *

data = IN[0]

if "Circle" in data[1]:
	OUT = data[2]
else:
	OUT = "Not Applicable"
# ----------------------------------------
code_block_14 = CodeBlock(LineModel=py_determine_column_shape, Section=py_determine_column_shape, ColumnLocation=center, SectionWidth=py_widthoutput, SectionLength=py_lengthoutput, Diameter=py_diameteroutput) { LineModel[0]; Section[1]; ColumnLocation; SectionWidth; SectionLength; Diameter; }
ColumnSectionLines = Output(code_block_14.out0)
ColumnShape = Output(code_block_14.out1)
ColumnLocation = Output(code_block_14.ColumnLocation)
ColumnWidth = Output(code_block_14.SectionWidth)
ColumnLength = Output(code_block_14.SectionLength)
ColumnDiameter = Output(code_block_14.Diameter)
