# Dynamo custom node __Pointcloud_Get_Point_Count.dyf "❄_Pointcloud Get Point Count" (Dynamo 2.10.1.3976)
# category: Sastrugi.Pointcloud.Geometry
# (Sastrugi_Pointcloud_Geometry) This node extracts number of points within the linked Recap Project file for the selected Pointcloud. Only functional with Revit 2022 API.

PointcloudInstance = Input(PointcloudInstance: var[]..[])
flatten = List.Flatten(list=PointcloudInstance)
elementType = Element.ElementType(element=flatten)
RunMe = Input(RunMe: bool = false)  # To prevent autorun issues this toggle has been included
py_read_rcp_file = Python(IN[0]=elementType, IN[1]=RunMe)  # IronPython2
# ---------- py_read_rcp_file.python (50 lines) ----------
# Python coding credit to Dynamo Forum user - @Ewan_Opie 2021
# Sastrugi Package https://sites.google.com/view/sastrugi/home

import clr
clr.AddReference("RevitNodes")
import Revit
clr.ImportExtensions(Revit.Elements)
clr.ImportExtensions(Revit.GeometryConversion)

clr.AddReference("RevitAPI")
import Autodesk
from Autodesk.Revit.DB import *
from Autodesk.Revit.DB.PointClouds import *

# Add Recap reference for Revit 2022 only
clr.AddReference("C:\Program Files\Autodesk\Revit 2022\AdskRcManaged.dll")

clr.AddReference('DSCoreNodes') 
import DSCore
from DSCore import *

def tolist(obj1):
	if hasattr(obj1,"__iter__"): return obj1
	else: return [obj1]	

def GetNumPoints(pc):
	try:
		proj = pc.GetReCapProject()
		total_pts =  proj.GetNumberOfPoints()
		return "RCP Total Points = "+ str(total_pts)
	except:
		return "Revit 2022 Function Only"

	
cloud = tolist(UnwrapElement(IN[0]))
runMe = IN[1]

counts = []
counts2 = []
if runMe:
	if len(cloud)>1:
		for c in cloud:
			counts.append(GetNumPoints(c))
	else:
		for c in cloud:
			counts2.append(GetNumPoints(c))
			counts = DSCore.List.Flatten(counts2,1)
	OUT = counts
else:
	OUT = ["Set RunMe to True"]
# ----------------------------------------
Returns_the_total_point_count_for_the_as = Output(py_read_rcp_file)  # "/*Returns the total point count for the asscociated Recap Project link PointCloud. Only functional for the Revit 2022 API*/ RCPTotalPoints"
