# Dynamo custom node __Pointcloud_Select_Points_By_Region.dyf "❄_Pointcloud Select Points By Region" (Dynamo 2.6.1.8786)
# category: Sastrugi.Pointcloud.Geometry
# (Sastrugi_Pointcloud_Geometry) This node allows users to select a specific number of Pointcloud Points by creating a selection region in the Active View.

# group: Coordinate System Transform from Survey Point (No Longer - Required but good reference)
categories = Categories("OST_SharedBasePoint")
all_elements_of_category = ElementsOfCategory(Category=categories)
code_block = CodeBlock { ["E/W","N/S","Elev"]; }
getParameterValueByName = Element.GetParameterValueByName(element=all_elements_of_category, parameterName=code_block, lacing=Longest)
code_block_2 = CodeBlock(sp=getParameterValueByName) { sp[0]; sp[1]; sp[2]; }
byOrigin = CoordinateSystem.ByOrigin(x=code_block_2.out0, y=code_block_2.out1, z=code_block_2.out2)
categories_2 = Categories("OST_ProjectBasePoint")
all_elements_of_category_2 = ElementsOfCategory(Category=categories_2)
code_block_3 = CodeBlock { ["E/W","N/S","Elev","Angle to True North"]; }
getParameterValueByName_2 = Element.GetParameterValueByName(element=all_elements_of_category_2, parameterName=code_block_3, lacing=Longest)
code_block_4 = CodeBlock(bp=getParameterValueByName_2) { bp[0]; bp[1]; bp[2]; }
byOrigin_2 = CoordinateSystem.ByOrigin(x=code_block_4.out0, y=code_block_4.out1, z=code_block_4.out2)
origin = CoordinateSystem.Origin(coordinateSystem=byOrigin_2)
ZAxis = Vector.ZAxis()
code_block_5 = CodeBlock(bp=getParameterValueByName_2) { bp[3]; }
rotate = CoordinateSystem.Rotate(coordinateSystem=byOrigin_2, origin=origin, axis=ZAxis, degrees=code_block_5)
transform = Geometry.Transform(fromCoordinateSystem=byOrigin, contextCoordinateSystem=rotate)  # unwired: geometry

# group: Global Refresh
Refresh = Input(Refresh: bool = false)
code_block_6 = CodeBlock(refresh=Refresh) { refresh; }

# group: Check if Units are Metric or Imperial
python_script = Python(IN[0]=code_block_6)
# ---------- python_script.python (16 lines) ----------
import clr

clr.AddReference('RevitAPI')
from Autodesk.Revit.DB import *

clr.AddReference('RevitServices')
import RevitServices
from RevitServices.Persistence import DocumentManager
from RevitServices.Transactions import TransactionManager

doc = DocumentManager.Instance.CurrentDBDocument

unittype = UnitType.UT_Length
formatoptions = doc.GetUnits().GetFormatOptions(unittype)
dispunits = formatoptions.DisplayUnits
OUT = str(dispunits)
# ----------------------------------------
code_block_7 = CodeBlock()
# ---------- code_block_7.designscript (3 lines) ----------
["Feet",
"Inches"];
true;
# ----------------------------------------
contains = String.Contains(str=python_script, searchFor=code_block_7.out0, ignoreCase=code_block_7.out1)
countTrue = List.CountTrue(list=contains)
code_block_8 = CodeBlock(n=countTrue)
# ---------- code_block_8.designscript (3 lines) ----------
n > 0?
1:
0;
# ----------------------------------------
code_block_9 = CodeBlock(passthrough=code_block_6, waitfor=code_block_8) { [passthrough,waitfor][0]; }

# group: Refresh Active View
code_block_10 = CodeBlock(passthrough=code_block_6, waitfor=code_block_9) { [passthrough,waitfor][0]; }
python_script_2 = Python(IN[0]=code_block_10)
# ---------- python_script_2.python (15 lines) ----------
import clr

clr.AddReference("RevitServices")
import RevitServices
from RevitServices.Persistence import DocumentManager

doc = DocumentManager.Instance.CurrentDBDocument

clr.AddReference("RevitNodes")
import Revit
clr.ImportExtensions(Revit.Elements)

refresh = IN[0]

OUT = doc.ActiveView.ToDSType(True)
# ----------------------------------------
firstItem = List.FirstItem(list=python_script_2)

# group: Get View Type
elementType = Element.ElementType(element=firstItem)
python_script_3 = Python(IN[0]=elementType)
# ---------- python_script_3.python (12 lines) ----------
import clr
clr.AddReference('RevitAPI')
from Autodesk.Revit.DB import *

def GetFamilyName(item):
	if hasattr(item, "FamilyName"): return item.FamilyName
	else: return None

items = UnwrapElement(IN[0])

if isinstance(IN[0], list): OUT = [GetFamilyName(x) for x in items]
else: OUT = GetFamilyName(items)
# ----------------------------------------

code_block_11 = CodeBlock { "Section Box"; }

# group: For 3D Views, Get Section Box for Geometry Intersect Check
getParameterValueByName_3 = Element.GetParameterValueByName(element=firstItem, parameterName=code_block_11)
flatten = List.Flatten(list=firstItem)
python_script_4 = Python(IN[0]=flatten)
# ---------- python_script_4.python (60 lines) ----------
#BIG THANKS TO @AWILLIAMS

import clr
clr.AddReference('ProtoGeometry')
from Autodesk.DesignScript.Geometry import *

clr.AddReference("RevitNodes")
import Revit
clr.ImportExtensions(Revit.Elements)

clr.AddReference("RevitServices")
import RevitServices
from RevitServices.Persistence import DocumentManager
from RevitServices.Transactions import TransactionManager

from System.Collections.Generic import *

clr.AddReference("RevitAPI")
import Autodesk
from Autodesk.Revit.DB import *

clr.ImportExtensions(Revit.GeometryConversion)

doc = DocumentManager.Instance.CurrentDBDocument
uiapp = DocumentManager.Instance.CurrentUIApplication
app = uiapp.Application


views = UnwrapElement(IN[0])

TransactionManager.Instance.EnsureInTransaction(doc)

sectionboxes = []

for view in views:
	sectionbox = view.GetSectionBox()
	transform = sectionbox.Transform
	sboxoriginx = transform.Origin.X
	sboxoriginy = transform.Origin.Y
	sboxoriginz = transform.Origin.Z
	vx = transform.BasisX.ToVector()
	bp = Point.Create(XYZ(sboxoriginx,sboxoriginy,sboxoriginz)).ToProtoType(True)
	minx = sectionbox.Min.X + sboxoriginx
	maxx = sectionbox.Max.X + sboxoriginx
	miny = sectionbox.Min.Y + sboxoriginy
	maxy = sectionbox.Max.Y + sboxoriginy
	minz = sectionbox.Min.Z + sboxoriginz
	maxz = sectionbox.Max.Z + sboxoriginz
	bbox = BoundingBoxXYZ()
	bbox.Min = XYZ((minx), (miny), (minz))
	bbox.Max = XYZ((maxx), (maxy), (maxz))
	tsectionbox = bbox.ToProtoType()
	sectionboxes.append(tsectionbox)
	sectionboxes.append(vx)
	sectionboxes.append(bp)

	
TransactionManager.Instance.TransactionTaskDone()

OUT = sectionboxes
# ----------------------------------------
code_block_12 = CodeBlock(p=python_script_4) { p[0]; p[1]; p[2]; }
toCuboid = BoundingBox.ToCuboid(boundingBox=code_block_12.out0)
ZAxis_2 = Vector.ZAxis()
YAxis = Vector.YAxis()
angleWithVector = Vector.AngleWithVector(vector=code_block_12.out1, otherVector=YAxis)
XAxis = Vector.XAxis()
angleWithVector_2 = Vector.AngleWithVector(vector=code_block_12.out1, otherVector=XAxis)
code_block_13 = CodeBlock(v=angleWithVector, this1=angleWithVector_2)
# ---------- code_block_13.designscript (3 lines) ----------
v>90?
0-this1:
this1;
# ----------------------------------------
rotate_2 = Geometry.Rotate(geometry=toCuboid, origin=code_block_12.out2, axis=ZAxis_2, degrees=code_block_13)

# group: Prompt Selection Rectangle
code_block_14 = CodeBlock(passthrough=code_block_6, waitfor=firstItem) { [passthrough,waitfor][0]; }
python_script_5 = Python(IN[0]=code_block_14, IN[1]=firstItem, IN[2]=code_block_8)
# ---------- python_script_5.python (62 lines) ----------
# Python coding credit to Dynamo Forum user - @Ewan_Opie 2019
# Sastrugi Package https://sites.google.com/view/sastrugi/home

import clr
clr.AddReference('RevitAPI')
import Autodesk
from Autodesk.Revit.DB import *

clr.AddReference("RevitServices")
import RevitServices
from RevitServices.Persistence import DocumentManager
from RevitServices.Transactions import TransactionManager

clr.AddReference("RevitAPIUI")
from  Autodesk.Revit.UI import *

clr.AddReference('ProtoGeometry')
from Autodesk.DesignScript.Geometry import *

clr.AddReference('DSCoreNodes') 
import DSCore
from DSCore import *

clr.AddReference("RevitNodes")
import Revit
clr.ImportExtensions(Revit.GeometryConversion)

doc = DocumentManager.Instance.CurrentDBDocument
uidoc=DocumentManager.Instance.CurrentUIApplication.ActiveUIDocument

# Start
TransactionManager.Instance.EnsureInTransaction(doc)

buttonlist = TaskDialogCommonButtons.Ok
TaskDialog.Show("Sastrugi","Please select a region in the Active View.",buttonlist)

pboxS=Autodesk.Revit.UI.Selection.PickBoxStyle.Enclosing
pickedBox = uidoc.Selection.PickBox(pboxS, "Select a box")
minP = UnwrapElement(pickedBox.Min)
maxP = UnwrapElement(pickedBox.Max)

if IN[2]==0:
	p1=Point.ByCoordinates(minP.X*304.8,minP.Y*304.8,minP.Z*304.8)
	p2=Point.ByCoordinates(maxP.X*304.8,maxP.Y*304.8,maxP.Z*304.8)
else:
	p1=Point.ByCoordinates(minP.X,minP.Y,minP.Z)
	p2=Point.ByCoordinates(maxP.X,maxP.Y,maxP.Z)

aView = UnwrapElement(IN[1])

aVO = aView.Origin.ToPoint()
aVD = aView.ViewDirection.ToVector()
aVP = Plane.ByOriginNormal(aVO,aVD)

rL = Line.ByStartPointEndPoint(p1,p2)
rLaVP = Curve.PullOntoPlane(rL,aVP)

newO = Curve.PointAtParameter(rLaVP,0.5)

TransactionManager.Instance.TransactionTaskDone()

OUT = aVP,rLaVP,newO,aView
# ----------------------------------------
code_block_15 = CodeBlock(out=python_script_5) { out[0]; out[1]; out[2]; out[3]; }

# group: Prompt Pick Pointcloud
code_block_16 = CodeBlock(passthrough=code_block_6, waitfor=python_script_5) { [passthrough,waitfor][0]; }
python_script_6 = Python(IN[0]=code_block_16)
# ---------- python_script_6.python (40 lines) ----------
import clr

clr.AddReference("RevitAPIUI")
from  Autodesk.Revit.UI import *

clr.AddReference("RevitServices")
import RevitServices
from RevitServices.Persistence import DocumentManager
doc = DocumentManager.Instance.CurrentDBDocument
uidoc=DocumentManager.Instance.CurrentUIApplication.ActiveUIDocument

clr.AddReference("RevitNodes")
import Revit
clr.ImportExtensions(Revit.Elements)

def flatten(*args):
    for x in args:
        if hasattr(x, '__iter__'):
            for y in flatten(*x):
                yield y
        else:
            yield x

sel1 = uidoc.Selection
ot1 = Selection.ObjectType.Element
msg = 'Pick PointCloud in Active View.'
TaskDialog.Show("Sastrugi", msg)
el_refs = sel1.PickObject(ot1, "Select")
typelist = list()
idlist = list()
el_ref = flatten(el_refs)
for i in el_ref:

	try:
		typelist.append(doc.GetElement(i.ElementId))
	except:
		typelist.apped(list())
		

OUT = typelist[-1]
# ----------------------------------------

# group: Create View Rectangle
ZAxis_3 = Vector.ZAxis()
code_block_17 = CodeBlock { 1000; }
translate = Geometry.Translate(geometry=code_block_15.out2, direction=ZAxis_3, distance=code_block_17)
normal = Plane.Normal(plane=code_block_15.out0)
translate_2 = Geometry.Translate(geometry=code_block_15.out2, direction=normal, distance=code_block_17)
byThreePoints = Plane.ByThreePoints(origin=code_block_15.out2, planePoint=translate, xAxisPoint=translate_2)
YAxis_2 = Plane.YAxis(plane=code_block_15.out0)
byOriginNormal = Plane.ByOriginNormal(origin=code_block_15.out2, normal=YAxis_2)
code_block_18 = CodeBlock(planecheck=byThreePoints, usethisone=byOriginNormal, usetheotherone=byThreePoints)
# ---------- code_block_18.designscript (3 lines) ----------
planecheck==null?
usethisone:
usetheotherone;
# ----------------------------------------
mirror = Geometry.Mirror(geometry=code_block_15.out1, mirrorPlane=code_block_18)
code_block_19 = CodeBlock { 0..1; }
pointAtParameter = Curve.PointAtParameter(curve=mirror, param=code_block_19)
pointAtParameter_2 = Curve.PointAtParameter(curve=code_block_15.out1, param=code_block_19)
create = List.Create(item0=pointAtParameter, item1=pointAtParameter_2)
transpose = List.Transpose(lists=create)
flatten_2 = List.Flatten(list=transpose)
byCornerPoints = Rectangle.ByCornerPoints(points=flatten_2)

# group: Plan View Offsets
python_script_7 = Python(IN[0]=firstItem, IN[1]=code_block_8)
# ---------- python_script_7.python (36 lines) ----------
import clr
clr.AddReference('RevitAPI')
import Autodesk
from Autodesk.Revit.DB import *

view = UnwrapElement(IN[0])
units = IN[1]

top = []
cut = []
bottom = []
depth = []

metric = 304.8
values = []
range = []

try:
	if units == 1:
		values.append(view.GetViewRange().GetOffset(PlanViewPlane.TopClipPlane))
		values.append(view.GetViewRange().GetOffset(PlanViewPlane.CutPlane))
		values.append(view.GetViewRange().GetOffset(PlanViewPlane.BottomClipPlane))
		values.append(view.GetViewRange().GetOffset(PlanViewPlane.ViewDepthPlane))
		range.append(min(values))
		range.append(max(values))
	else:
		values.append((view.GetViewRange().GetOffset(PlanViewPlane.TopClipPlane))*metric)
		values.append((view.GetViewRange().GetOffset(PlanViewPlane.CutPlane))*metric)
		values.append((view.GetViewRange().GetOffset(PlanViewPlane.BottomClipPlane))*metric)
		values.append((view.GetViewRange().GetOffset(PlanViewPlane.ViewDepthPlane))*metric)
		range.append(min(values))
		range.append(max(values))
except:
	range.append([0,10000000])

OUT = range
# ----------------------------------------
minimumItem = List.MinimumItem(list=python_script_7)
maximumItem = List.MaximumItem(list=python_script_7)

# group: Section and Detail View Offsets
code_block_20 = CodeBlock { "Far Clipping"; }
getParameterValueByName_4 = Element.GetParameterValueByName(element=firstItem, parameterName=code_block_20)
code_block_21 = CodeBlock { "Far Clip Offset"; }
getParameterValueByName_5 = Element.GetParameterValueByName(element=firstItem, parameterName=code_block_21)
code_block_22 = CodeBlock(clipping=getParameterValueByName_4, useclip=getParameterValueByName_5)
# ---------- code_block_22.designscript (3 lines) ----------
clipping>0?
useclip:
10000000;
# ----------------------------------------

# group: 3D View Offsets
code_block_23 = CodeBlock { "Far Clip Active"; }
getParameterValueByName_6 = Element.GetParameterValueByName(element=firstItem, parameterName=code_block_23)
code_block_24 = CodeBlock { "Far Clip Offset"; }
getParameterValueByName_7 = Element.GetParameterValueByName(element=firstItem, parameterName=code_block_24)
code_block_25 = CodeBlock(clipping=getParameterValueByName_6, useclip=getParameterValueByName_7)  # same code as code_block_22

# group: Correct Offsets
code_block_26 = CodeBlock(viewtype=python_script_3, planmin=minimumItem, planmax=maximumItem, sdoffset=code_block_22, viewdepth3d=code_block_25) { viewtype; planmin; planmax; sdoffset; viewdepth3d; }
python_script_8 = Python(IN[0]=code_block_26.viewtype, IN[1]=code_block_26.planmin, IN[2]=code_block_26.planmax, IN[3]=code_block_26.sdoffset, IN[4]=code_block_26.viewdepth3d)
# ---------- python_script_8.python (30 lines) ----------
import clr

clr.AddReference('DSCoreNodes') 
import DSCore
from DSCore import *

viewtype = IN[0]
planmin = IN[1]
planmax = IN[2]
sdoffset = IN[3]
viewdepth3d = IN[4]

away = []
towards = []

if String.Contains(viewtype,'Plan') == True:
	towards.append(planmax)
	away.append(planmin)

elif String.Contains(viewtype,'Section') or String.Contains(viewtype,'Detail') == True:
	towards.append(0)
	away.append(sdoffset*-1)
elif String.Contains(viewtype,'3D') == True:
	towards.append(viewdepth3d)
	away.append(viewdepth3d*-1)
else:
	towards.append(1000)
	away.append(-1000)
	
OUT = towards,away
# ----------------------------------------

# group: Selection Box
normal_2 = Plane.Normal(plane=code_block_15.out0)
code_block_27 = CodeBlock(result=python_script_8) { result[0]; result[1]; }
translate_3 = Geometry.Translate(geometry=byCornerPoints, direction=normal_2, distance=code_block_27.out0)
translate_4 = Geometry.Translate(geometry=byCornerPoints, direction=normal_2, distance=code_block_27.out1)
join = List.Join(list0=translate_3, list1=translate_4)
byLoft = Solid.ByLoft(crossSections=join)

faces = Topology.Faces(topology=byLoft)
vertices = Face.Vertices(face=faces)

# group (continued): Selection Box
pointGeometry = Vertex.PointGeometry(vertex=vertices)
byBestFitThroughPoints = Plane.ByBestFitThroughPoints(points=pointGeometry)
origin_2 = Plane.Origin(plane=byBestFitThroughPoints)

# group: Solid Centroid
boundingBox = Geometry.BoundingBox(geometry=byLoft)
maxPoint = BoundingBox.MaxPoint(boundingBox=boundingBox)
minPoint = BoundingBox.MinPoint(boundingBox=boundingBox)
join_2 = List.Join(list0=maxPoint, list1=minPoint)
code_block_28 = CodeBlock(pts=join_2) { pt = Math.Average([pts.X,pts.Y,pts.Z]); pt[0]; pt[1]; pt[2]; }
byCoordinates = Point.ByCoordinates(x=code_block_28.out1, y=code_block_28.out2, z=code_block_28.out3)

# group (continued): Selection Box
byTwoPoints = Vector.ByTwoPoints(start=origin_2, end=byCoordinates, lacing=Longest)
byOriginNormal_2 = Plane.ByOriginNormal(origin=origin_2, normal=byTwoPoints)

PointSampleSize = Input(PointSampleSize: int = 1000)  # This is the number of points to take from within the selected region. Please note that the actual number of Points output may vary from this number if a Sectionbox has been used.

# group: Initial Point Grab
code_block_29 = CodeBlock(pcinstance=python_script_6, boxplane=byOriginNormal_2, PointSampleSize=PointSampleSize) { pcinstance; boxplane; 0.001; PointSampleSize; }
flatten_3 = List.Flatten(list=code_block_29.pcinstance)
firstItem_2 = List.FirstItem(list=flatten_3)
python_script_9 = Python(IN[0]=firstItem_2, IN[1]=code_block_29.boxplane, IN[2]=code_block_29.out2, IN[3]=code_block_29.PointSampleSize)
# ---------- python_script_9.python (46 lines) ----------
import clr
clr.AddReference('ProtoGeometry')
from Autodesk.DesignScript.Geometry import *

clr.AddReference("RevitNodes")
import Revit
clr.ImportExtensions(Revit.Elements)

clr.ImportExtensions(Revit.GeometryConversion)

clr.AddReference("RevitServices")
import RevitServices
from RevitServices.Persistence import DocumentManager
from RevitServices.Transactions import TransactionManager
from System.Collections.Generic import *

clr.AddReference("RevitAPI")
import Autodesk
from Autodesk.Revit.DB import *
from Autodesk.Revit.DB.PointClouds import *


doc = DocumentManager.Instance.CurrentDBDocument
uiapp = DocumentManager.Instance.CurrentUIApplication
app = uiapp.Application
uidoc=DocumentManager.Instance.CurrentUIApplication.ActiveUIDocument

planes=[]
for i in IN[1]:
	planes.append(UnwrapElement(i).ToPlane())
Iplanes=List[Autodesk.Revit.DB.Plane](planes)

pcf=PointCloudFilterFactory.CreateMultiPlaneFilter(planes)

averageDistance = IN[2]
numberOfPoints= IN[3]

points = UnwrapElement(IN[0]).GetPoints(pcf, averageDistance, numberOfPoints)
elements=[]
for p in points:
	X=p.X
	Y=p.Y
	Z=p.Z
	elements.append(Point.Create(XYZ(X,Y,Z)).ToProtoType(True))

OUT = elements
# ----------------------------------------
flatten_4 = List.Flatten(list=python_script_9)

# group: Adjust Points for Pointcloud Instance Scale
code_block_30 = CodeBlock(passthrough=code_block_29.pcinstance, waitfor=python_script_9) { [passthrough,waitfor][0]; }
elementType_2 = Element.ElementType(element=code_block_30)
code_block_31 = CodeBlock { "Scale"; }
getParameterValueByName_8 = Element.GetParameterValueByName(element=elementType_2, parameterName=code_block_31)
scale = Geometry.Scale(geometry=flatten_4, xamount=getParameterValueByName_8, yamount=getParameterValueByName_8, zamount=getParameterValueByName_8)

# group: Pointcloud Coordinate System Adjustment
identity = CoordinateSystem.Identity()
python_script_10 = Python(IN[0]=flatten_3)
# ---------- python_script_10.python (49 lines) ----------
#BIG THANKS TO @AWILLIAMS

import clr
clr.AddReference('ProtoGeometry')
from Autodesk.DesignScript.Geometry import *

clr.AddReference("RevitNodes")
import Revit
clr.ImportExtensions(Revit.Elements)

clr.AddReference("RevitServices")
import RevitServices
from RevitServices.Persistence import DocumentManager
from RevitServices.Transactions import TransactionManager

from System.Collections.Generic import *

clr.AddReference("RevitAPI")
import Autodesk
from Autodesk.Revit.DB import *

clr.ImportExtensions(Revit.GeometryConversion)

doc = DocumentManager.Instance.CurrentDBDocument
uiapp = DocumentManager.Instance.CurrentUIApplication
app = uiapp.Application


cloud = UnwrapElement(IN[0])

TransactionManager.Instance.EnsureInTransaction(doc)


cloudtransform = []

for c in cloud:
	transform = c.GetTotalTransform()
	X = transform.Origin.X
	Y = transform.Origin.Y
	Z = transform.Origin.Z
	bX = transform.BasisX.ToVector()
	bY = transform.BasisY.ToVector()
	point = Point.Create(XYZ(X,Y,Z)).ToProtoType(True)
	cloudtransform.append(point)
	cloudtransform.append(bX)
		
TransactionManager.Instance.TransactionTaskDone()

OUT = cloudtransform
# ----------------------------------------
code_block_32 = CodeBlock(p=python_script_10) { p[0]; p[1]; }
ZAxis_4 = Vector.ZAxis()
byOriginNormal_3 = Plane.ByOriginNormal(origin=code_block_32.out0, normal=ZAxis_4)
ZAxis_5 = Vector.ZAxis()
X = Vector.X(vector=code_block_32.out1)
Y = Vector.Y(vector=code_block_32.out1)
XAxis_2 = Vector.XAxis()
angleWithVector_3 = Vector.AngleWithVector(vector=code_block_32.out1, otherVector=XAxis_2)
python_script_11 = Python(IN[0]=code_block_32.out1, IN[1]=X, IN[2]=Y, IN[3]=angleWithVector_3)
# ---------- python_script_11.python (16 lines) ----------
# Load the Python Standard and DesignScript Libraries
import sys
import clr
clr.AddReference('ProtoGeometry')
from Autodesk.DesignScript.Geometry import *

vec = IN[0]
xv = IN[1]
yv = IN[2]
va = IN[3]

if xv>yv:
	OUT = 360-va
else:
	OUT = va-360
	
# ----------------------------------------
rotate_3 = Geometry.Rotate(geometry=byOriginNormal_3, origin=code_block_32.out0, axis=ZAxis_5, degrees=python_script_11)
byPlane = CoordinateSystem.ByPlane(plane=rotate_3)
transform_2 = Geometry.Transform(geometry=scale, fromCoordinateSystem=identity, contextCoordinateSystem=byPlane, lacing=Longest)

# group: Check for SectionBox Intersects for 3D Views Only
code_block_33 = CodeBlock { "3D"; }
contains_2 = String.Contains(str=python_script_3, searchFor=code_block_33)
doesIntersect = Geometry.DoesIntersect(geometry=transform_2, other=rotate_2)
filterByBoolMask = List.FilterByBoolMask(list=transform_2, mask=doesIntersect)
python_script_12 = Python(IN[0]=contains_2, IN[1]=getParameterValueByName_3, IN[2]=filterByBoolMask.in, IN[3]=transform_2, IN[4]=transform_2)
# ---------- python_script_12.python (17 lines) ----------
import sys
import clr
clr.AddReference('ProtoGeometry')
from Autodesk.DesignScript.Geometry import *

is3d = IN[0]
sectionenabled = IN[1]
pass1 = IN[2]
pass2= IN[3]
pass3 = IN[4]

if is3d == True and sectionenabled == 1:
	OUT = pass1
elif is3d == True and sectionenabled == 0:
	OUT = pass2
else:
	OUT = pass3
# ----------------------------------------

# group: Results
flatten_5 = List.Flatten(list=python_script_12)
OutputPoints = Output(flatten_5)
byBestFitThroughPoints_2 = Plane.ByBestFitThroughPoints(points=flatten_5)
BestFitPlane = Output(byBestFitThroughPoints_2)

Troubleshooting = Input(Troubleshooting: bool = true)  # !!! Not an Input !!! - Troubleshooting - If no points are being returned when trying to select a region in a 3D view, a forced refresh of the Active View plane may be necessary. To do this perform the following steps: 1 - Select the Pointcloud Instance 2 - Use the Zoom-All command, or click a corner of the Viewcube 3 - Refresh the Node and attempt a region selection
