# Dynamo custom node __Pointcloud_Set_Graphics_Override.dyf "❄_Pointcloud Set Graphics Override" (Dynamo 2.2.1.5175)
# category: Sastrugi.Pointcloud.Graphics
# (Sastrugi-Pointcloud_Graphics) Overrides the graphics for a Pointcloud instance in the specified views.

PointcloudInstance = Input(PointcloudInstance: var[]..[])
PointcloudOverrideSettings = Input(PointcloudOverrideSettings: var[]..[])
ViewList = Input(ViewList: var[]..[])
python_script = Python(IN[0]=PointcloudInstance, IN[1]=PointcloudOverrideSettings, IN[2]=ViewList)
# ---------- python_script.python (62 lines) ----------
# Python coding credit to Dynamo Forum user - @Ewan_Opie 2019
# Sastrugi Package https://sites.google.com/view/sastrugi/home

import clr
clr.AddReference("RevitNodes")
import Revit
clr.ImportExtensions(Revit.Elements)

clr.AddReference("RevitServices")
import RevitServices
from RevitServices.Persistence import DocumentManager
from RevitServices.Transactions import TransactionManager

from System.Collections.Generic import *

clr.AddReference("RevitAPI")
import Autodesk
from Autodesk.Revit.DB import *

from Autodesk.Revit import DB

import sys
pyt_path = r'C:\Program Files (x86)\IronPython 2.7\Lib'
sys.path.append(pyt_path)

clr.ImportExtensions(Revit.GeometryConversion)

doc = DocumentManager.Instance.CurrentDBDocument
uiapp = DocumentManager.Instance.CurrentUIApplication
app = uiapp.Application

def tolist(obj1):
	if hasattr(obj1,"__iter__"): return obj1
	else: return [obj1]	
	
cloud = tolist(UnwrapElement(IN[0]))

pcORsettings = tolist(IN[1])

views = tolist(UnwrapElement(IN[2]))

TransactionManager.Instance.EnsureInTransaction(doc)

try:
		errorReport = None
		for c in cloud:
			for v in views:
				pt_overrides = v.GetPointCloudOverrides()
			for p in pcORsettings:
				pt_overrides.SetPointCloudScanOverrideSettings(c.Id, p)
except:
		import traceback
		errorReport = str(traceback.format_exc())
		
TransactionManager.Instance.TransactionTaskDone()

if errorReport == None:
	OUT = cloud
else:
	OUT = errorReport

	
# ----------------------------------------
PointcloudInstance_2 = Output(python_script)  # "PointcloudInstance"
