# Dynamo custom node __Random Point Cube.dyf "❄_Random Point Cube" (Dynamo 1.3.4.6666)
# category: Sastrugi.Points
# (Sastrugi_Points) This node creates and controls the density of random points within a defined maximum cube space.

MaximumSize = Input()
Density = Input(Density: double=0.5)  # Range 0 min to 1 max
code_block = CodeBlock(maxsize=MaximumSize, desity=Density) { 0; maxsize; desity; }

# group: Size Control
randomList = Math.RandomList(code_block.maxsize)
minimumItem = List.MinimumItem(randomList)
maximumItem = List.MaximumItem(randomList)
randomList_2 = Math.RandomList(code_block.maxsize)
mapTo = MapTo(minimumItem, maximumItem, randomList_2, code_block.out0, code_block.maxsize)
minimumItem_2 = List.MinimumItem(randomList_2)
maximumItem_2 = List.MaximumItem(randomList_2)
mapTo_2 = MapTo(minimumItem_2, maximumItem_2, randomList_2, code_block.out0, code_block.maxsize)
randomList_3 = Math.RandomList(code_block.maxsize)
minimumItem_3 = List.MinimumItem(randomList_3)
maximumItem_3 = List.MaximumItem(randomList_3)
mapTo_3 = MapTo(minimumItem_3, maximumItem_3, randomList_3, code_block.out0, code_block.maxsize)

# group: Density Control
code_block_2 = CodeBlock(a=code_block.maxsize) { a-1; }
code_block_3 = CodeBlock(x=code_block_2) { 0..x; }
shuffle = List.Shuffle(code_block_3)
shuffle_2 = List.Shuffle(code_block_3)
shuffle_3 = List.Shuffle(mapTo)
shuffle_4 = List.Shuffle(code_block_3)
code_block_4 = CodeBlock { 0; 1; }
mapTo_4 = MapTo(code_block_4.out0, code_block_4.out1, Density, code_block_4.out0, code_block.maxsize)
takeItems = List.TakeItems(list=shuffle_4, amount=mapTo_4)
getItemAtIndex = List.GetItemAtIndex(list=shuffle_3, index=takeItems)
shuffle_5 = List.Shuffle(mapTo_2)
takeItems_2 = List.TakeItems(list=shuffle_4, amount=mapTo_4)
getItemAtIndex_2 = List.GetItemAtIndex(list=shuffle_5, index=takeItems_2)
shuffle_6 = List.Shuffle(mapTo_3)
takeItems_3 = List.TakeItems(list=shuffle_4, amount=mapTo_4)
getItemAtIndex_3 = List.GetItemAtIndex(list=shuffle_6, index=takeItems_3)

byCoordinates = Point.ByCoordinates(x=getItemAtIndex, y=getItemAtIndex_2, z=getItemAtIndex_3)
RandomPoints = Output(byCoordinates)
