# Dynamo custom node __Remake Polycurve.dyf "❄_Remake Polycurve" (Dynamo 1.3.2.2480)
# category: Sastrugi.Curves
# (Sastrugi_Curves) This node deconstructs a Polycurve and rebuilds it using approximated curves.

PolyCurve = Input()
curves = PolyCurve.Curves(PolyCurve)
approximateWithArcAndLineSegments = Curve.ApproximateWithArcAndLineSegments(curves)
flatten = Flatten(approximateWithArcAndLineSegments)
byJoinedCurves = PolyCurve.ByJoinedCurves(flatten)
PolyCurve_2 = Output(byJoinedCurves)  # "PolyCurve"
