# Dynamo custom node __Remake_Polycurve.dyf "❄_Remake Polycurve" (Dynamo 2.2.1.5175)
# category: Sastrugi.Curves
# (Sastrugi_Curves) This node deconstructs a Polycurve and rebuilds it using approximated curves.

InputPolyCurve = Input(InputPolyCurve: var[]..[])
curves = PolyCurve.Curves(polyCurve=InputPolyCurve)
approximateWithArcAndLineSegments = Curve.ApproximateWithArcAndLineSegments(curve=curves)
flatten = List.Flatten(list=approximateWithArcAndLineSegments)
byJoinedCurves = PolyCurve.ByJoinedCurves(curves=flatten)
PolyCurve = Output(byJoinedCurves)
