# Dynamo custom node __Set Sketchplane By Face.dyf "❄_Set Sketchplane By Face" (Dynamo 1.3.3.4111)
# category: Sastrugi.Selection
# (Sastrugi_Selection) This node allows users to select a Face in Revit to become the Active Sketchplane.

Refresh = Input(Refresh: bool=false)
python_script = Python(IN[0]=Refresh)
# ---------- python_script.python (35 lines) ----------
import clr

clr.AddReference("RevitAPIUI")
from  Autodesk.Revit.UI import *

clr.AddReference("RevitServices")
import RevitServices
from RevitServices.Persistence import DocumentManager
doc = DocumentManager.Instance.CurrentDBDocument
uidoc=DocumentManager.Instance.CurrentUIApplication.ActiveUIDocument

clr.AddReference("RevitNodes")
import Revit
clr.ImportExtensions(Revit.Elements)
clr.ImportExtensions(Revit.GeometryConversion)

clr.AddReference('RevitAPI')
from Autodesk.Revit.DB import *

surfaces = []
msg="Select Face to Set Sketchplane."

TaskDialog.Show("Sastrugi", msg)
ref = uidoc.Selection.PickObject(Selection.ObjectType.Face,'')

obj = doc.GetElement(ref.ElementId)
i1 = obj.GetGeometryObjectFromReference(ref)
if isinstance(obj, FamilyInstance):
	tr = obj.GetTransform().ToCoordinateSystem()
	i2 = i1.Convert(ref, tr)
else:
	i2 = i1.ToProtoType(True)
	for i in i2: i.Tags.AddTag("RevitFaceReference", ref)
surfaces.append(i2)
OUT = surfaces
# ----------------------------------------
code_block = CodeBlock(list=python_script) { Flatten({list}); }
vertices = Topology.Vertices(code_block)
pointGeometry = Vertex.PointGeometry(vertices)
flatten = Flatten(pointGeometry)
firstItem = List.FirstItem(flatten)
lastItem = List.LastItem(flatten)
XY = Plane.XY()
normal = Plane.Normal(XY)
code_block_2 = CodeBlock { 0.5; }
normalAtParameter = Surface.NormalAtParameter(surface=code_block, u=code_block_2, v=code_block_2)
ZAxis = Vector.ZAxis()
angleAboutAxis = Vector.AngleAboutAxis(normal, normalAtParameter, ZAxis)
code_block_3 = CodeBlock(x=angleAboutAxis)
# ---------- code_block_3.designscript (7 lines) ----------
x>=0 && x<=89.999 ?
false:
x==90 ?
false:
x>=90.001 ?
false:
true;
# ----------------------------------------
firstItem_2 = List.FirstItem(code_block_3)
pointAtParameter = Surface.PointAtParameter(surface=code_block, u=code_block_2, v=code_block_2)
firstItem_3 = List.FirstItem(pointAtParameter)
code_block_4 = CodeBlock { 100; }
translate = Geometry.Translate(geometry=pointAtParameter, direction=normalAtParameter, distance=code_block_4)
firstItem_4 = List.FirstItem(translate)
byTwoPoints = Vector.ByTwoPoints(start=firstItem_3, end=firstItem_4)
byTwoPoints_2 = Vector.ByTwoPoints(start=firstItem, end=lastItem)
code_block_5 = CodeBlock { 90; }
rotate = Vector.Rotate(byTwoPoints, byTwoPoints_2, code_block_5)
code_block_6 = CodeBlock(flat=byTwoPoints, vert=rotate) { flat; vert; }
if_ = If(test=firstItem_2, true=code_block_6.flat, false=code_block_6.vert)
current = Document.Current()
activeView = Document.ActiveView(current)

# group: Credit @Einar_Raknes for coding
python_script_2 = Python(IN[0]=firstItem, IN[1]=lastItem, IN[2]=if_, IN[3]=activeView)
# ---------- python_script_2.python (45 lines) ----------
import clr
clr.AddReference('ProtoGeometry')
from Autodesk.DesignScript.Geometry import *

clr.AddReference("RevitNodes")
import Revit
clr.ImportExtensions(Revit.Elements)

clr.ImportExtensions(Revit.GeometryConversion)

clr.AddReference("RevitServices")
import RevitServices
from RevitServices.Persistence import DocumentManager
from RevitServices.Transactions import TransactionManager

doc = DocumentManager.Instance.CurrentDBDocument
uiapp = DocumentManager.Instance.CurrentUIApplication
app = uiapp.Application

clr.AddReference("RevitAPI")
import Autodesk
from Autodesk.Revit.DB import *

doc = DocumentManager.Instance.CurrentDBDocument
uiapp = DocumentManager.Instance.CurrentUIApplication
app = uiapp.Application

dataEnteringNode = IN

startpoint = UnwrapElement(IN[0]).ToRevitType()
endpoint = UnwrapElement(IN[1]).ToRevitType()
perpV = UnwrapElement(IN[2]).ToRevitType()
Aview = UnwrapElement(doc.ActiveView.ToDSType(True))

TransactionManager.Instance.EnsureInTransaction(doc)
rPlane = doc.Create.NewReferencePlane(startpoint,endpoint,perpV,Aview)
TransactionManager.Instance.TransactionTaskDone()

TransactionManager.Instance.EnsureInTransaction(doc)
sp = SketchPlane.Create(doc,rPlane.Id)
doc.ActiveView.SketchPlane = sp
doc.Delete(rPlane.Id)
TransactionManager.Instance.TransactionTaskDone()

OUT = sp
# ----------------------------------------

ActiveSketchplane = Output(python_script_2)
