# Dynamo custom node __Shortest_Path_By_Curve.dyf "❄_Shortest Path By Curve" (Dynamo 2.6.1.8786)
# category: Sastrugi.Curves
# (Sastrugi_Curve) This node finds the shortest path between two points along a series of joined curves. All curves must be jointed within the series at either their 0 or 1 parameter.
# packages: Sastrugi 2.0.1

# group: Input
InputCurves = Input(InputCurves: var[]..[])  # Must all be joined at 0 and 1 parameters
code_block = CodeBlock(inputcurves=InputCurves) { inputcurves; }
StartPoint = Input(StartPoint: var[]..[])  # Must occur at the end of a branch curve
flatten = List.Flatten(list=StartPoint)
EndPoint = Input(EndPoint: var[]..[])  # Must occur at the end of a branch curve
flatten_2 = List.Flatten(list=EndPoint)
code_block_2 = CodeBlock(start=flatten, end=flatten_2) { start; end; }

# group: Split Curves
flatten_3 = List.Flatten(list=code_block)
code_block_3 = CodeBlock { [0.3,0.6]; }
splitByParameter = Curve.SplitByParameter(curve=flatten_3, parameters=code_block_3)
flatten_4 = List.Flatten(list=splitByParameter)

# group: Group Curves - Credit to #springnodes - Dimitar_Venkov
code_block_4 = CodeBlock(lines=flatten_4) { lines:var[]; }
code_block_5 = CodeBlock { margin:double = 100; }
python_script = Python(IN[0]=code_block_4, IN[1]=code_block_5)
# ---------- python_script.python (69 lines) ----------
import clr

clr.AddReference('ProtoGeometry')
from Autodesk.DesignScript.Geometry import *

curves = IN[0]
margin = IN[1]
original = curves[:]

def OrderCurves(cl0,cl1):
	def switch1(i, j, cl0 = cl0, cl1 = cl1):
		cl0[i],cl0[j] = cl0[j],cl0[i]
		cl1[i],cl1[j] = cl1[j],cl1[i]

	_ln = len(cl1)
	xr1 =  xrange(_ln)
	int_test = [[cl1[i].DoesIntersect(cl1[j])\
	for j in xr1 if j != i] for i in xr1]
	countT = map(sum, int_test)
	if 0 not in countT:
		if 1 in countT and countT[0] != 1 :
			switch1(0, countT.index(1) )
		for i in xrange(_ln - 1):
			k = i + 1
			if cl1[i].DoesIntersect(cl1[k]) : pass
			else :
				try:
					int_test = [cl1[i].DoesIntersect(cl1[j])\
					for j in xrange(k, _ln)]
					switch1(k, k + int_test.index(True) )
				except : pass
	return cl0, cl1

def ClosedCase(cl0,cl1):
	pts = [cl1[i-1].Intersect(cl1[i])[0] for i in xrange(len(cl1) )]
	return PolyCurve.ByPoints(pts,True).Curves()

def OpenCase(cl0,cl1):
	def FarPt(l1, p1):
		pts = (l1.StartPoint,l1.EndPoint)
		return max(pts, key = p1.DistanceTo)

	pts = [cl1[i].Intersect(cl1[i+1])[0] for i in xrange(len(cl1) -1)]
	pts.append(FarPt(cl0[-1],pts[-1]))
	pts.insert(0,FarPt(cl0[0],pts[0]))
	return PolyCurve.ByPoints(pts).Curves()

def joinCurves(cl0,th1):
	len1 = len(cl0)
	if len1 < 2 : return cl0, False
	else:
		cl1 = [c.ExtendStart(th1).ExtendEnd(th1) for c in cl0]
		cl0, cl1 = OrderCurves(cl0,cl1)
		_fn = ClosedCase if cl1[0].DoesIntersect(cl1[-1]) and len1 > 2 else OpenCase
		try : return _fn(cl0,cl1), True
		except : return cl0, False

def ReorderCurves(orig, new):
	reordered, new = [], list(new)
	app1, pop1, PaP = reordered.append, new.pop, Curve.PointAtParameter
	for i in xrange(len(orig) ):
		p1 = PaP(orig[i],0.5)
		p2 = [PaP(new[j],0.5) for j in xrange(len(new) )]
		ind1 = p2.index(min(p2, key = p1.DistanceTo) )
		app1(pop1(ind1) )
	return reordered

out1 = joinCurves(curves, margin)
OUT = out1[0], ReorderCurves(original,out1[0]), out1[1]
# ----------------------------------------
code_block_6 = CodeBlock(o=python_script) { o[0]; o[1]; o[2]; }
code_block_7 = CodeBlock(success=code_block_6.out2) { success; }
code_block_8 = CodeBlock(lines=code_block_6.out0) { lines; }
code_block_9 = CodeBlock(ordered=code_block_6.out1) { ordered; }

# group: Intersects
code_block_10 = CodeBlock(a=code_block_9) { a; }
deconstruct = List.Deconstruct(list=code_block_10)
doesIntersect = Geometry.DoesIntersect(geometry=code_block_10, other=deconstruct.rest)

# group: Count Boolean - Credit #Clockwork - Andreas_Dieckmann
python_script_2 = Python(IN[0]=doesIntersect)
# ---------- python_script_2.python (20 lines) ----------
import clr

bool = IN[0]
listt = list()
listt.append(0)
tcount = 0
listf = list()
listf.append(0)
fcount = 0

for item in bool:
	if item == True:
		listt[tcount] += 1
		fcount += 1
		listf.append(0)
	elif item == False:
		listf[fcount] += 1
		tcount += 1
		listt.append(0)
OUT = (listt,listf)
# ----------------------------------------
code_block_11 = CodeBlock(seq=python_script_2) { seq[0]; seq[1]; }
formula = Formula("x=0")  # unwired: x
filter = List.Filter(list=code_block_11.out0, condition=formula)
filter_2 = List.Filter(list=code_block_11.out1, condition=formula)

# group: Routes - Pass 1
create = List.Create(item0=filter.out, item1=filter_2.out)
transpose = List.Transpose(lists=create)
code_block_12 = CodeBlock { 1; }
code_block_13 = CodeBlock { null; }
eq = _ == code_block_13  # unwired: x
replaceByCondition = Replace(item=transpose, replaceWith=code_block_12, condition=eq)
sum = Math.Sum()  # unwired: values
map = List.Map(list=replaceByCondition, f_x=sum)
code_block_14 = CodeBlock { false; }
clean = List.Clean(list=map, preserveIndices=code_block_14)

chop = List.Chop(list=code_block_10, lengths=clean)
byJoinedCurves = PolyCurve.ByJoinedCurves(curves=chop)
curves = PolyCurve.Curves(polyCurve=byJoinedCurves)
code_block_15 = CodeBlock { 0..1000; }
count = List.Count()  # unwired: list
map_2 = List.Map(list=curves, f_x=count)
takeItems = List.TakeItems(list=code_block_15, amount=map_2)
curves_2 = PolyCurve.Curves(polyCurve=byJoinedCurves)
startPoint = Curve.StartPoint(curve=curves_2)
string_from_object = FromObject(obj=startPoint)
endPoint = Cone.EndPoint(cone=byJoinedCurves)
parameterAtPoint = Curve.ParameterAtPoint(curve=byJoinedCurves, point=endPoint, lacing=CrossProduct)
startPoint_2 = Curve.StartPoint(curve=byJoinedCurves)
parameterAtPoint_2 = Curve.ParameterAtPoint(curve=byJoinedCurves, point=startPoint_2, lacing=CrossProduct)
create_2 = List.Create(item0=parameterAtPoint, item1=parameterAtPoint_2)
transpose_2 = List.Transpose(lists=create_2)
code_block_16 = CodeBlock(x=transpose_2)
# ---------- code_block_16.designscript (7 lines) ----------
x==1 ?
false:
x==0 ?
false:
x==null ?
false:
true;
# ----------------------------------------
filterByBoolMask = List.FilterByBoolMask(list=transpose_2, mask=code_block_16)
pointAtParameter = Curve.PointAtParameter(curve=byJoinedCurves, param=filterByBoolMask.in)
code_block_17 = CodeBlock { true; }
clean_2 = List.Clean(list=pointAtParameter, preserveIndices=code_block_17)
string_from_object_2 = FromObject(obj=clean_2)
indexOf = List.IndexOf(list=string_from_object@L2, element=string_from_object_2@L1, lacing=CrossProduct)
code_block_18 = CodeBlock(x=indexOf)
# ---------- code_block_18.designscript (3 lines) ----------
x<=0 ?
false:
true;
# ----------------------------------------
filterByBoolMask_2 = List.FilterByBoolMask(list=indexOf, mask=code_block_18)
sort = List.Sort()  # unwired: list
map_3 = List.Map(list=filterByBoolMask_2.in, f_x=sort)
split_list_at_index = Custom[❄_Split List At Index](InputList=takeItems@L2, ElementList=map_3@L2)  # package Sastrugi; (Sastrugi_Lists) This node splits a list by at the Index locations of specific Elements.
count_2 = List.Count(list=split_list_at_index@L2, lacing=Longest)
count_3 = List.Count(list=split_list_at_index@L3)
chop_2 = List.Chop(list=count_2, lengths=count_3)
chop_3 = List.Chop(list=curves@L2, lengths=chop_2@L2)

# group: Find Shortest Path
byJoinedCurves_2 = PolyCurve.ByJoinedCurves(curves=chop_3)
flatten_5 = List.Flatten(list=byJoinedCurves_2)
count_4 = List.Count(list=flatten_5)
code_block_19 = CodeBlock(n=count_4) { 0..n; }
combinations = List.Combinations(list=flatten_5, length=code_block_19)
byJoinedCurves_3 = PolyCurve.ByJoinedCurves(curves=combinations@L2)
code_block_20 = CodeBlock { false; }
clean_3 = List.Clean(list=byJoinedCurves_3, preserveIndices=code_block_20)
startPoint_3 = Curve.StartPoint(curve=clean_3)
endPoint_2 = Curve.EndPoint(curve=clean_3)
create_3 = List.Create(item0=startPoint_3, item1=endPoint_2)
transpose_3 = List.Transpose(lists=create_3)
reverse = List.Reverse()  # unwired: list
map_4 = List.Map(list=transpose_3, f_x=reverse)
join = List.Join(list0=code_block_2.start, list1=code_block_2.end)
create_4 = List.Create(item0=join)
distanceTo = Geometry.DistanceTo(geometry=map_4, other=create_4, lacing=Longest)
code_block_21 = CodeBlock { 0; }
eq_2 = distanceTo == code_block_21  # lacing=Longest
allTrue = List.AllTrue(list=eq_2@L2)
distanceTo_2 = Geometry.DistanceTo(geometry=transpose_3, other=create_4, lacing=Longest)
eq_3 = distanceTo_2 == code_block_21  # lacing=Longest
allTrue_2 = List.AllTrue(list=eq_3@L2)
or_ = allTrue || allTrue_2
filterByBoolMask_3 = List.FilterByBoolMask(list=clean_3, mask=or_)
length = Curve.Length(curve=filterByBoolMask_3.in)
sortIndexByValue = List.SortIndexByValue(list=length)
firstItem = List.FirstItem(list=sortIndexByValue)
getItemAtIndex = List.GetItemAtIndex(list=filterByBoolMask_3.in, index=firstItem)
curves_3 = PolyCurve.Curves(polyCurve=getItemAtIndex)
deconstruct_2 = List.Deconstruct(list=sortIndexByValue)
getItemAtIndex_2 = List.GetItemAtIndex(list=filterByBoolMask_3.in, index=deconstruct_2.rest)

# group: Output
ShortestPath = Output(getItemAtIndex)
ShortestPathCurves = Output(curves_3)
OtherPaths = Output(getItemAtIndex_2)
