# Dynamo custom node __Sort Points by Average Vector.dyf "❄_Sort Points by Average Vector" (Dynamo 1.3.2.2480)
# category: Sastrugi.Points
# (Sastrugi_Points) This node sorts points by the average vector through them.

ReverseVector = Input(ReverseVector:bool = false)
UnsortedPoints = Input()
flatten = Flatten(UnsortedPoints)
byBestFitThroughPoints = Line.ByBestFitThroughPoints(flatten)
parameterAtPoint = Curve.ParameterAtPoint(curve=byBestFitThroughPoints, point=UnsortedPoints)
sortIndexByValue = SortIndexByValue(parameterAtPoint)
getItemAtIndex = List.GetItemAtIndex(list=UnsortedPoints, index=sortIndexByValue)
flatten_2 = Flatten(getItemAtIndex)
code_block = CodeBlock { true; }
clean = List.Clean(list=flatten_2, preserveIndices=code_block)
reverse = List.Reverse(clean)
if_ = If(test=ReverseVector, true=reverse, false=clean)
SortedPoints = Output(if_)
