# Dynamo custom node __Surface Plane.dyf "❄_Surface Plane" (Dynamo 1.3.3.4111)
# category: Sastrugi.Geometry
# (Sastrugi_Geometry) This node will extract a plane that best fits a surface.

InputSurfaces = Input()

# group: Convert Surfaces to Planes
faces = Topology.Faces(InputSurfaces)
vertices = Face.Vertices(faces)
pointGeometry = Vertex.PointGeometry(vertices)
byBestFitThroughPoints = Plane.ByBestFitThroughPoints(pointGeometry)

Planes = Output(byBestFitThroughPoints)
