# Dynamo custom node SeparateBeamsAndColumns.dyf (Dynamo 1.2.1.3083)
# category: Revit.Elements.StructuralFraming
# Splits lists of curves/lines into separate beam and column lists for element create

Curves = Input()  # "Curves[]"
separate_beams = Python(IN[0]=Curves)
# ---------- separate_beams.python (32 lines) ----------
import clr
clr.AddReference('ProtoGeometry')
from Autodesk.DesignScript.Geometry import *

# Import RevitNodes
clr.AddReference("RevitNodes")
import Revit
# Import Revit elements
from Revit.Elements import *
import System

# import Revit complete API package
clr.AddReference("RevitAPI")
import Autodesk

#Use generic features from .NET platform
from System.Collections.Generic import *

#The inputs to this node will be stored as a list in the IN variables.
l = IN[0]

lBeams = []

i = 0

while i < l.Count:
	if l[i].StartPoint.Z == l[i].EndPoint.Z:
		lBeams.append(l[i])
	i = i + 1

#Assign your output to the OUT variable.
OUT = lBeams
# ----------------------------------------
Beams = Output(separate_beams)
separate_columns = Python(IN[0]=Curves)
# ---------- separate_columns.python (36 lines) ----------
import clr
clr.AddReference('ProtoGeometry')
from Autodesk.DesignScript.Geometry import *

# Import RevitNodes
clr.AddReference("RevitNodes")
import Revit
# Import Revit elements
from Revit.Elements import *
import System

# import Revit complete API package
clr.AddReference("RevitAPI")
import Autodesk

#Use generic features from .NET platform
from System.Collections.Generic import *

#The inputs to this node will be stored as a list in the IN variables.
l = IN[0]

lColumns = []

i = 0

while i < l.Count:
	if l[i].StartPoint.Z != l[i].EndPoint.Z:
		if l[i].StartPoint.Z < l[i].EndPoint.Z:
			lColumns.append(l[i])
		else:
			lN = Line.ByStartPointEndPoint(l[i].EndPoint, l[i].StartPoint)
			lColumns.append(lN)
	i = i + 1

#Assign your output to the OUT variable.
OUT = lColumns
# ----------------------------------------
Columns = Output(separate_columns)
