# Dynamo custom node BOP ENG.dyf (Dynamo 1.3.2.2480)
# category: Serveone

element = Input(element : Element)

# group: 파이프만 선택
string = StringInput("Pipes")
getCategory = Element.GetCategory(element)
name = Category.Name(getCategory)
eq = string == name
filterByBoolMask = List.FilterByBoolMask(list=element, mask=eq)

# group: 경사가 0인 항목만 필터링
code_block = CodeBlock { 0; "Slope"; }
getParameterValueByName = Element.GetParameterValueByName(element=filterByBoolMask.in, parameterName=code_block.out1)
eq_2 = code_block.out0 == getParameterValueByName
filterByBoolMask_2 = List.FilterByBoolMask(list=filterByBoolMask.in, mask=eq_2)

a = Input()
code_block_2 = CodeBlock { "Outside Diameter"; }
getParameterValueByName_2 = Element.GetParameterValueByName(element=filterByBoolMask_2.in, parameterName=code_block_2)
code_block_3 = CodeBlock(a=getParameterValueByName_2) { a*304.8; }
code_block_4 = CodeBlock(a=a, b=code_block_3) { a+(b/2); }

# group: 간격띄우기에 입력
code_block_5 = CodeBlock { "Offset"; }
setParameterByName = Element.SetParameterByName(element=filterByBoolMask_2.in, parameterName=code_block_5, value=code_block_4)

Element = Output(setParameterByName)
