# Dynamo custom node BOT ENG.dyf (Dynamo 1.3.2.2480)
# category: Serveone

element = Input(element : Element)

# group: 트레이만 선택
string = StringInput("Cable Trays")
getCategory = Element.GetCategory(element)
name = Category.Name(getCategory)
eq = string == name
filterByBoolMask = List.FilterByBoolMask(list=element, mask=eq)

a = Input()
code_block = CodeBlock { "Height"; }
getParameterValueByName = Element.GetParameterValueByName(element=filterByBoolMask.in, parameterName=code_block)
code_block_2 = CodeBlock(a=getParameterValueByName) { a*304.8; }
code_block_3 = CodeBlock(a=a, b=code_block_2) { a+(b/2); }

# group: 간격띄우기 매개변수에 계산된값 입력
code_block_4 = CodeBlock { "Offset"; }
setParameterByName = Element.SetParameterByName(element=filterByBoolMask.in, parameterName=code_block_4, value=code_block_3)

Element = Output(setParameterByName)
