# Dynamo custom node BOT KOR.dyf (Dynamo 1.3.2.2480)
# category: Serveone

a = Input()
element = Input(element : Element)

# group: 트레이만 선택
string = StringInput("케이블 트레이")
getCategory = Element.GetCategory(element)
name = Category.Name(getCategory)
eq = string == name
filterByBoolMask = List.FilterByBoolMask(list=element, mask=eq)

code_block = CodeBlock { "높이"; }
getParameterValueByName = Element.GetParameterValueByName(element=filterByBoolMask.in, parameterName=code_block)
code_block_2 = CodeBlock(a=getParameterValueByName) { a*304.8; }
code_block_3 = CodeBlock(a=a, b=code_block_2) { a+(b/2); }

# group: 간격띄우기 매개변수에 계산된값 입력
code_block_4 = CodeBlock { "간격띄우기"; }
setParameterByName = Element.SetParameterByName(element=filterByBoolMask.in, parameterName=code_block_4)  # unwired: value

Element = Output(setParameterByName)
