# Dynamo graph TestReadDefinition.dyn (Dynamo 2.10.1.3976)
# packages: SketchUpForDynamo 1.6.0

file_path = Filename(".\TestModel.skp")
boolean = BoolSelector(false)  # graph input
loadModel = SketchUpForDynamo.SketchUp.LoadModel(path=file_path, includeMeshes=boolean)
getInstance = SketchUpForDynamo.SketchUp.GetInstance(instance=loadModel.Instances)
