# Dynamo custom node Createadraftingview.dyf "CreateDraftingView" (Dynamo 2.5.0.7460)
# category: Smort
# Create multiple drafting view

boolean = Input(boolean: bool = true)
scale = Input(scale: int = 100)
Nos = Input(Nos: int = 1)
python_script = Python(IN[0]=boolean, IN[1]=scale, IN[2]=Nos)
# ---------- python_script.python (63 lines) ----------
import clr
import sys
sys.path.append('C:\Program Files (x86)\IronPython 2.7\Lib')
import System
from System import Array
from System.Collections.Generic import *
clr.AddReference('ProtoGeometry')
from Autodesk.DesignScript.Geometry import *
clr.AddReference("RevitNodes")
import Revit
clr.ImportExtensions(Revit.Elements)
clr.ImportExtensions(Revit.GeometryConversion)
clr.AddReference("RevitServices")
import RevitServices
from RevitServices.Persistence import DocumentManager 
from RevitServices.Transactions import TransactionManager 

clr.AddReference("RevitAPI")
clr.AddReference("RevitAPIUI")

import Autodesk 
from Autodesk.Revit.DB import *
from Autodesk.Revit.UI import *

doc = DocumentManager.Instance.CurrentDBDocument
uiapp = DocumentManager.Instance.CurrentUIApplication 
app = uiapp.Application 
uidoc = uiapp.ActiveUIDocument

dataEnteringNode = IN

TransactionManager.Instance.EnsureInTransaction(doc)

existdraftview = FilteredElementCollector(doc).OfClass(ViewFamilyType)
bool = IN[0]
scalevalue = IN[1]
nos = IN[2]
df = []

for i in existdraftview:
	if i.ViewFamily == ViewFamily.Drafting:
		df.append(i.Id)
		
newdraftingviewid = []

for i in df:
	for j in df:
		newdraftingviewid.append(i)

a = []
if bool:

	for i in range(nos):
		a.append(ViewDrafting.Create(doc, newdraftingviewid[0]))

setscale = []	
for i in a:
	setscale = i.get_Parameter(BuiltInParameter.VIEW_SCALE_PULLDOWN_METRIC).Set(scalevalue)


TransactionManager.Instance.TransactionTaskDone()

OUT = a,setscale
# ----------------------------------------
OUT = Output(python_script)
