# Dynamo custom node SparteMeshStructure.dyf (Dynamo 1.3.2.2480)
# category: SPARTE

Level_level = Input()
all_elements_at_level = ElementsAtLevel(Level_level)
watch = Watch(all_elements_at_level)
structureCategories = Custom[StructureCategories]()  # unwired: element
map = List.Map(list=watch, f_x=structureCategories)
filterByBoolMask = List.FilterByBoolMask(list=all_elements_at_level, mask=map)
flatten = Flatten(filterByBoolMask.in)
geometry = Element.Geometry(flatten, lacing=Longest)
isNull = Object.IsNull(geometry)
filterByBoolMask_2 = List.FilterByBoolMask(list=geometry, mask=isNull)
flatten_2 = Flatten(filterByBoolMask_2.out)
byUnion = Solid.ByUnion(flatten_2)
categories = Categories("GenericModel")
name = Level.Name(Level_level)
byGeometry = DirectShape.ByGeometry(geometry=byUnion, category=categories, name=name)
