# Dynamo custom node StructureCategories.dyf (Dynamo 1.3.2.2480)
# category: SPARTE

categories = Categories("Columns")
id = Category.Id(categories)
categories_2 = Categories("Walls")
id_2 = Category.Id(categories_2)
categories_3 = Categories("Floors")
id_3 = Category.Id(categories_3)
categories_4 = Categories("StructuralColumns")
id_4 = Category.Id(categories_4)
create = List.Create(id, id_2, id_3, id_4)
element = Input()
getCategory = Element.GetCategory(element)
id_5 = Category.Id(getCategory)
contains = Contains(create, id_5)
bool = Output(contains)
