# Dynamo custom node Tool.IntersectionChecker.dyf (Dynamo 1.0.0.1180)
# category: SteamNodes.Tool
# Checks if elements have a geometrical intersection. The result is a list of list, with First Element is checked against the others.

join = List.Join()
# note: Element A will be checked against B elements and the result is returned with A as first element of a list, then intersecting elements.
Element_A = Input()
code_block = CodeBlock(item=Element_A) { Flatten({item}); }
geometry = Element.Geometry(code_block)
flatten = Flatten(geometry)
Element_B = Input()
code_block_2 = CodeBlock(item=Element_B) { Flatten({item}); }
setDifference = SetDifference(code_block_2, code_block)
geometry_2 = Element.Geometry(setDifference)
flatten_2 = Flatten(geometry_2)
doesIntersect = Geometry.DoesIntersect(other=flatten_2)
map = List.Map(list=flatten, f_x=doesIntersect)
filterByBoolMask = List.FilterByBoolMask(list=setDifference)
map_2 = List.Map(list=map, f_x=filterByBoolMask.in)
combine = List.Combine(join, code_block, map_2)
A_B_elements = Output(combine)  # "A + B elements"
deconstruct = List.Deconstruct()
map_3 = List.Map(list=combine, f_x=deconstruct.first)
A = Output(map_3)
map_4 = List.Map(list=combine, f_x=deconstruct.rest)
Intersecting_Elements = Output(map_4)
