# Dynamo graph Base.dyn (Dynamo 0.7.5.3566)

# note: Combo filled with available forces results.
forces = BarForces("FZ")
# note: Create a regular Dynamo line between (0,0) and (length,0)
origin = Point.Origin()
cantilever_length = DoubleSlider(5, range=0..10)
byCoordinates = Point.ByCoordinates(cantilever_length)
byStartPointEndPoint = Line.ByStartPointEndPoint(origin, byCoordinates)
# note: Transform the Dynamo line to RSA bar
byLine = DynamoSimulation.RSA.AnalyticalModel.AnalyticalBar.ByLine(byStartPointEndPoint)
# note: Combo that will be filled automatically with the list of cross section available in RSA project.
# If RSA is not opened, using this node will start RSA with a default 3D shell project.
sections = SectionBar("B 8x16")
# note: Apply to the analytical bar a cross section using name. This cross section must be available in RSA project.
setSectionByName = DynamoSimulation.RSA.AnalyticalModel.AnalyticalBar.SetSectionByName(byLine, sections)
# note: Get the analytcal node at (0,0) to apply a specific type of support.
startNode = DynamoSimulation.RSA.AnalyticalModel.AnalyticalBar.StartNode(setSectionByName)
# note: Combo that will be filled automatically with the list of support typesavailable in RSA project. This combo will contains a "None" value.  This could be useful to  remove some supports previously created by the script.
supports = Support("Fixed")
# note: Apply to the analytical node a  support using the name.
setSupportByName = DynamoSimulation.RSA.AnalyticalModel.AnalyticalNode.SetSupportByName(startNode, supports)
# note: Create a list of analytical elements and flatten it to  be sure that the model will be recalculated if something as changed before the calculation node.
create = List.Create(setSectionByName, setSupportByName)
flatten = Flatten(create)
# note: The calculate need at this point a list of elements (analytical bars and nodes). Simulation is sensitive and to  limit calculation warnings a first set of check are done to be sure that all bars have a section and at least one support exist on the model.
# Note also than if no load case have been defined in RSA project (using dynamo or manually), a dead load case will be created an include the self weight of the model.
calculate = DynamoSimulation.RSA.RSACore.Calculate(flatten)
# note: Pick  the cantilever beam
firstItem = List.FirstItem(calculate)
# note: Get the extreme values for a specific bar, type of results and load case.
getExtremeValuesAndPositions = DynamoSimulation.RSA.RSAResults.BarForces.GetExtremeValuesAndPositions(forces, firstItem)
watch = Watch(getExtremeValuesAndPositions.out0)
watch_2 = Watch(getExtremeValuesAndPositions.out1)
# note: Pick  the support
lastItem = List.LastItem(calculate)
# note: Get reaction values for  a specific node and load case id. If no load case are specified, the index 1 will  be used.
getValues = DynamoSimulation.RSA.RSAResults.NodeReactions.GetValues(lastItem)
watch_3 = Watch(getValues.out2)
