# Dynamo graph BaseLoads.dyn (Dynamo 0.7.5.3566)

code_block = CodeBlock { "MY"; }
origin = Point.Origin()
cantilever_length = DoubleSlider(4, range=0..10)
byCoordinates = Point.ByCoordinates(cantilever_length)
byStartPointEndPoint = Line.ByStartPointEndPoint(origin, byCoordinates)
byLine = DynamoSimulation.RSA.AnalyticalModel.AnalyticalBar.ByLine(byStartPointEndPoint)
sections = SectionBar("B 8x16")
setSectionByName = DynamoSimulation.RSA.AnalyticalModel.AnalyticalBar.SetSectionByName(byLine, sections)
code_block_2 = CodeBlock { "Live"; }
case_type = CaseType("Simple")
code_block_3 = CodeBlock { "LiveUniform"; }
# note: Create a load case for uniform loads.
# For the version 1.0.2, uniform and point loads should be in different load cases
byNatureAndType = DynamoSimulation.RSA.AnalyticalModel.Loads.LoadCase.ByNatureAndType(code_block_2, case_type, code_block_3)
code_block_4 = CodeBlock { -500; }
# note: Apply  to a set of bars uniform loads
byBars = DynamoSimulation.RSA.AnalyticalModel.Loads.UniformLoad.ByBars(setSectionByName, byNatureAndType, arg4=code_block_4)
endNode = DynamoSimulation.RSA.AnalyticalModel.AnalyticalBar.EndNode(setSectionByName)
code_block_5 = CodeBlock { "Live"; }
case_type_2 = CaseType("Simple")
code_block_6 = CodeBlock { "LivePoint"; }
# note: Create a load case for point loads
byNatureAndType_2 = DynamoSimulation.RSA.AnalyticalModel.Loads.LoadCase.ByNatureAndType(code_block_5, case_type_2, code_block_6)
code_block_7 = CodeBlock { -1500; }
# note: Apply  to a set of bars point loads
byNodes = DynamoSimulation.RSA.AnalyticalModel.Loads.PointLoad.ByNodes(endNode, byNatureAndType_2, arg4=code_block_7)
startNode = DynamoSimulation.RSA.AnalyticalModel.AnalyticalBar.StartNode(setSectionByName)
supports = Support("Fixed")
setSupportByName = DynamoSimulation.RSA.AnalyticalModel.AnalyticalNode.SetSupportByName(startNode, supports)
case_nature = CaseNature("Dead")
case_type_3 = CaseType("Simple")
code_block_8 = CodeBlock { "SelfWeight"; }
byNatureAndType_3 = DynamoSimulation.RSA.AnalyticalModel.Loads.LoadCase.ByNatureAndType(case_nature, case_type_3, code_block_8)
code_block_9 = CodeBlock { 1.2; }
modelSelfWeight = DynamoSimulation.RSA.AnalyticalModel.Loads.LoadCase.ModelSelfWeight(byNatureAndType_3, code_block_9)
create = List.Create(byBars, byNodes, setSectionByName, setSupportByName, modelSelfWeight)
flatten = Flatten(create)
calculateAndSort = DynamoSimulation.RSA.RSACore.CalculateAndSort(flatten)
firstItem = List.FirstItem(calculateAndSort.out0)
integer_slider = IntegerSlider(2, range=1..3)
getExtremeValuesAndPositions = DynamoSimulation.RSA.RSAResults.BarForces.GetExtremeValuesAndPositions(code_block, firstItem, integer_slider)
watch = Watch(getExtremeValuesAndPositions.out2)
firstItem_2 = List.FirstItem(calculateAndSort.out1)
getValues = DynamoSimulation.RSA.RSAResults.NodeReactions.GetValues(firstItem_2, integer_slider)
watch_2 = Watch(getValues.out4)
