# Dynamo graph BaseSelfWeight.dyn (Dynamo 0.7.5.3566)

code_block = CodeBlock { "FZ"; }
origin = Point.Origin()
cantilever_length = DoubleSlider(5, range=0..10)
byCoordinates = Point.ByCoordinates(cantilever_length)
byStartPointEndPoint = Line.ByStartPointEndPoint(origin, byCoordinates)
byLine = DynamoSimulation.RSA.AnalyticalModel.AnalyticalBar.ByLine(byStartPointEndPoint)
sections = SectionBar("B 8x16")
setSectionByName = DynamoSimulation.RSA.AnalyticalModel.AnalyticalBar.SetSectionByName(byLine, sections)
startNode = DynamoSimulation.RSA.AnalyticalModel.AnalyticalBar.StartNode(setSectionByName)
supports = Support("Fixed")
setSupportByName = DynamoSimulation.RSA.AnalyticalModel.AnalyticalNode.SetSupportByName(startNode, supports)
# note: Load case nature combo is filled with "Dead", "Live", "Snow" and "Wind"
case_nature = CaseNature("Dead")
# note: Load case type combo is filled with "Simple" at this point."Combination" will be added later.
case_type = CaseType("Simple")
# note: The name of the load case
code_block_2 = CodeBlock { "SelfWeight"; }
# note: Create the load case in RSA.
byNatureAndType = DynamoSimulation.RSA.AnalyticalModel.Loads.LoadCase.ByNatureAndType(case_nature, case_type, code_block_2)
# note: Coefficient to  apply  to the calculated Self-weight
code_block_3 = CodeBlock { 1.2; }
# note: Apply to all elements included inside the  model a dead load equals to  the selfweight.
modelSelfWeight = DynamoSimulation.RSA.AnalyticalModel.Loads.LoadCase.ModelSelfWeight(byNatureAndType, code_block_3)
# note: Add the load case to  the list to be sure that changes are taken into  consideration during evaluation
create = List.Create(setSectionByName, setSupportByName, modelSelfWeight)
flatten = Flatten(create)
# note: This node run the calculations in RSA and classify elements for further usages.
calculateAndSort = DynamoSimulation.RSA.RSACore.CalculateAndSort(flatten)
firstItem = List.FirstItem(calculateAndSort.out0)
getExtremeValuesAndPositions = DynamoSimulation.RSA.RSAResults.BarForces.GetExtremeValuesAndPositions(code_block, firstItem)
watch = Watch(getExtremeValuesAndPositions)
firstItem_2 = List.FirstItem(calculateAndSort.out1)
getValues = DynamoSimulation.RSA.RSAResults.NodeReactions.GetValues(firstItem_2)
watch_2 = Watch(getValues.out2)
