# Dynamo graph BeamsNetwork.dyn (Dynamo 0.7.5.3566)

integer_slider = IntegerSlider(5, range=0..50)
integer_slider_2 = IntegerSlider(5, range=0..50)
code_block = CodeBlock(u=integer_slider, v=integer_slider_2) { UV.ByCoordinates((0..1..1/u)<1>,(0..1..1/v)<2>); }
flatten = Flatten(code_block)
x_left = DoubleSlider(0, range=0..100)
line_1_y = DoubleSlider(7, range=0..100)
line_1_and_3_z = DoubleSlider(0, range=0..100)
byCoordinates = Point.ByCoordinates(x_left, line_1_y, line_1_and_3_z)
x_right = DoubleSlider(20, range=0..100)
byCoordinates_2 = Point.ByCoordinates(x_right, line_1_y, line_1_and_3_z)
line_2_y = DoubleSlider(12, range=10..20)
line_2_right_z = DoubleSlider(-10, range=-10..10)
byCoordinates_3 = Point.ByCoordinates(x_left, line_2_y, line_2_right_z)
line_2_left_z = DoubleSlider(8, range=0..10)
byCoordinates_4 = Point.ByCoordinates(x_right, line_2_y, line_2_left_z)
line_3_y = DoubleSlider(30, range=0..100)
byCoordinates_5 = Point.ByCoordinates(x_left, line_3_y, line_1_and_3_z)
byCoordinates_6 = Point.ByCoordinates(x_right, line_3_y, line_1_and_3_z)
code_block_2 = CodeBlock(p1=byCoordinates, p2=byCoordinates_2, p3=byCoordinates_3, p4=byCoordinates_4, p5=byCoordinates_5, p6=byCoordinates_6)
# ---------- code_block_2.designscript (4 lines) ----------
l1 = Line.ByStartPointEndPoint(p1, p2);
l2 = Line.ByStartPointEndPoint(p3, p4);
l3 = Line.ByStartPointEndPoint(p5, p6);
surf = Surface.ByLoft({l1, l2, l3});
# ----------------------------------------
byParametersOnSurface = Tessellation.Voronoi.ByParametersOnSurface(flatten, code_block_2.surf)
byLine = DynamoSimulation.RSA.AnalyticalModel.AnalyticalBar.ByLine(byParametersOnSurface)
sections = SectionBar("B 8x16")
setSectionByName = DynamoSimulation.RSA.AnalyticalModel.AnalyticalBar.SetSectionByName(byLine, sections)
