# Dynamo graph Truss.dyn (Dynamo 0.7.5.3566)

forces = BarForces("FX")
# note: Truss length
double_slider = DoubleSlider(10, range=0..20)
# note: Number of vertical posts
number = DoubleInput(4)
code_block = CodeBlock(l=double_slider, amount=number) { 0..l..#amount; }
# note: Truss height
double_slider_2 = DoubleSlider(2, range=0..2)
byCoordinates = Point.ByCoordinates(code_block, arg2=double_slider_2)
firstItem = List.FirstItem(byCoordinates)
lastItem = List.LastItem(byCoordinates)
# note: Top chord
byStartPointEndPoint = Line.ByStartPointEndPoint(firstItem, lastItem)
# note: Create analytical bars
byLine = DynamoSimulation.RSA.AnalyticalModel.AnalyticalBar.ByLine(byStartPointEndPoint)
sections = SectionBar("B 8x16")
# note: Apply cross section
setSectionByName = DynamoSimulation.RSA.AnalyticalModel.AnalyticalBar.SetSectionByName(byLine, sections)
byCoordinates_2 = Point.ByCoordinates(code_block)
# note: Post
byStartPointEndPoint_2 = Line.ByStartPointEndPoint(byCoordinates, byCoordinates_2)
byLine_2 = DynamoSimulation.RSA.AnalyticalModel.AnalyticalBar.ByLine(byStartPointEndPoint_2)
bar_sections = SectionBar("B 8x16")
setSectionByName_2 = DynamoSimulation.RSA.AnalyticalModel.AnalyticalBar.SetSectionByName(byLine_2, bar_sections)
code_block_2 = CodeBlock(nb=number) { nb-1; }
removeItemAtIndex = List.RemoveItemAtIndex(byCoordinates, code_block_2)
code_block_3 = CodeBlock { 0; }
removeItemAtIndex_2 = List.RemoveItemAtIndex(byCoordinates_2, code_block_3)
# note: Diagonal
byStartPointEndPoint_3 = Line.ByStartPointEndPoint(removeItemAtIndex, removeItemAtIndex_2)
byLine_3 = DynamoSimulation.RSA.AnalyticalModel.AnalyticalBar.ByLine(byStartPointEndPoint_3)
bar_sections_2 = SectionBar("B 8x16")
setSectionByName_3 = DynamoSimulation.RSA.AnalyticalModel.AnalyticalBar.SetSectionByName(byLine_3, bar_sections_2)
firstItem_2 = List.FirstItem(byCoordinates_2)
lastItem_2 = List.LastItem(byCoordinates_2)
# note: Bottom chord
byStartPointEndPoint_4 = Line.ByStartPointEndPoint(firstItem_2, lastItem_2)
byLine_4 = DynamoSimulation.RSA.AnalyticalModel.AnalyticalBar.ByLine(byStartPointEndPoint_4)
bar_sections_3 = SectionBar("B 8x16")
setSectionByName_4 = DynamoSimulation.RSA.AnalyticalModel.AnalyticalBar.SetSectionByName(byLine_4, bar_sections_3)
startNode = DynamoSimulation.RSA.AnalyticalModel.AnalyticalBar.StartNode(setSectionByName_4)
supports = Support("Fixed")
setSupportByName = DynamoSimulation.RSA.AnalyticalModel.AnalyticalNode.SetSupportByName(startNode, supports)
# note: Assign support at the start and the end of the bottom chord
endNode = DynamoSimulation.RSA.AnalyticalModel.AnalyticalBar.EndNode(setSectionByName_4)
supports_2 = Support("Fixed")
setSupportByName_2 = DynamoSimulation.RSA.AnalyticalModel.AnalyticalNode.SetSupportByName(endNode, supports_2)
# note: Agregate all analytical elements
create = List.Create(setSectionByName, setSectionByName_2, setSectionByName_3, setSectionByName_4, setSupportByName, setSupportByName_2)
flatten = Flatten(create)
# note: Run calculation
calculateAndSort = DynamoSimulation.RSA.RSACore.CalculateAndSort(flatten)
firstItem_3 = List.FirstItem(calculateAndSort.out0)
getMaxValue = DynamoSimulation.RSA.RSAResults.BarForces.GetMaxValue(forces, firstItem_3)
forces_2 = BarForces("FX")
# note: Get values for a specific bar
getMinValue = DynamoSimulation.RSA.RSAResults.BarForces.GetMinValue(forces_2, firstItem_3)
forces_3 = BarForces("FX")
code_block_4 = CodeBlock { 1; }
# note: Get extrem values for a set of bars
getExtremeValuesAndPositionsByLists = DynamoSimulation.RSA.RSAResults.BarForces.GetExtremeValuesAndPositionsByLists(forces_3, calculateAndSort.out0, code_block_4)
forces_4 = BarForces("FX")
getExtremeValuesAndPositions = DynamoSimulation.RSA.RSAResults.BarForces.GetExtremeValuesAndPositions(forces_4, firstItem_3)
forces_5 = BarForces("FX")
getValueAt = DynamoSimulation.RSA.RSAResults.BarForces.GetValueAt(forces_5, firstItem_3)
reactions = NodeReactions("FX")
lastItem_3 = List.LastItem(calculateAndSort.out1)
getValue = DynamoSimulation.RSA.RSAResults.NodeReactions.GetValue(reactions, lastItem_3)
# note: Get reactions values for a node support
getValues = DynamoSimulation.RSA.RSAResults.NodeReactions.GetValues(lastItem_3)
