# Dynamo custom node AL.Duplicate Item Indices.dyf (Dynamo 2.1.0.7500)
# category: Synthesize.Packages.Archi-lab_Grimshaw.List.List
# Searches an input list for duplicate entries and lists their index numbers. Couple with Get From List to delete duplicates from a list.

VARList = Input(VARList: var[]..[])
python_script = Python(IN[0]=VARList)
# ---------- python_script.python (23 lines) ----------
#Copyright(c) 2015, Konrad Sobon
# @arch_laboratory, http://archi-lab.net

import clr
clr.AddReference('ProtoGeometry')
from Autodesk.DesignScript.Geometry import *
#The inputs to this node will be stored as a list in the IN variable.
dataEnteringNode = IN

mylist = IN[0]

a, seen, result, unique = mylist, set(), [], []
for idx, item in enumerate(a):
    if item not in seen:
    	seen.add(item)
    	unique.append(idx)        
    	# First time seeing the element
    else:
    	result.append(idx)
    	# Already seen, add the index to the result

#Assign your output to the OUT variable
OUT = unique, result
# ----------------------------------------
number = DoubleInput(0)  # graph input
getItemAtIndex = List.GetItemAtIndex(list=python_script, index=number)
VARUniqueIndices = Output(getItemAtIndex)
number_2 = DoubleInput(1)  # graph input
getItemAtIndex_2 = List.GetItemAtIndex(list=python_script, index=number_2)
VARDuplicateIndices = Output(getItemAtIndex_2)
