# Dynamo custom node AL.Get Built In Parameter.dyf (Dynamo 2.1.0.7500)
# category: Synthesize.Packages.archilab.Revit.Parameter
# This node will take an input of a built in parameter name and element to return that parameters value.

VARParameterNames = Input(VARParameterNames: var[]..[])
VARElements = Input(VARElements: var[]..[])
python_script = Python(IN[0]=VARParameterNames, IN[1]=VARElements)
# ---------- python_script.python (109 lines) ----------
#Copyright(c) 2015, Konrad K Sobon
# @arch_laboratory, http://archi-lab.net

import clr
import sys
clr.AddReference('ProtoGeometry')
from Autodesk.DesignScript.Geometry import *

pyt_path = r'C:\Program Files (x86)\IronPython 2.7\Lib'
sys.path.append(pyt_path)

# Import Element wrapper extension methods
clr.AddReference("RevitNodes")
import Revit
clr.ImportExtensions(Revit.Elements)

# Import DocumentManager and TransactionManager
clr.AddReference("RevitServices")
import RevitServices
from RevitServices.Persistence import DocumentManager
from RevitServices.Transactions import TransactionManager

doc = DocumentManager.Instance.CurrentDBDocument
uiapp = DocumentManager.Instance.CurrentUIApplication
app = uiapp.Application

# Import RevitAPI
clr.AddReference("RevitAPI")
import Autodesk
from Autodesk.Revit.DB import *
import System

#The inputs to this node will be stored as a list in the IN variable.
dataEnteringNode = IN

paramNames = IN[0]

if isinstance(IN[1], list):
	sheets = []
	for i in IN[1]:
		sheets.append(UnwrapElement(i))
else:
	sheets = IN[1]

elements = []
for i in sheets:
	elements.append(UnwrapElement(i))

def ProcessList(_func, _list):
    return map( lambda x: ProcessList(_func, x) if type(x)==list else _func(x), _list )

def ProcessListArg(_func, _list, _arg):
    return map( lambda x: ProcessListArg(_func, x, _arg) if type(x)==list else _func(x, _arg), _list )

def GetBuiltInParam(paramName):
	builtInParams = System.Enum.GetValues(BuiltInParameter)
	test = []
	for i in builtInParams:
		if i.ToString() == paramName:
			test.append(i)
			break
		else:
			continue
	return test[0]

def GetBipValue(element, bip):
	doc = DocumentManager.Instance.CurrentDBDocument
	value = None
	try:
		tempValue = element.get_Parameter(bip)
	except:
		tempValue = None
		pass
	if tempValue != None and tempValue.HasValue:
		if element.get_Parameter(bip).StorageType == StorageType.String:
			value = element.get_Parameter(bip).AsString()
		elif element.get_Parameter(bip).StorageType == StorageType.Integer:
			value  = element.get_Parameter(bip).AsInteger()
		elif element.get_Parameter(bip).StorageType == StorageType.Double:
			value = element.get_Parameter(bip).AsDouble()
		elif element.get_Parameter(bip).StorageType == StorageType.ElementId:
			id = element.get_Parameter(bip).AsElementId()
			value = doc.GetElement(id)
		return value
	else:
		return None

try:
	errorReport = None
	paramValues = []
	if isinstance(paramNames, list):
		builtInParams = ProcessList(GetBuiltInParam, paramNames)
		for i in builtInParams:
			paramValues.append(ProcessListArg(GetBipValue, elements, i))
	else:
		builtInParams = GetBuiltInParam(paramNames)
		if isinstance(sheets, list):
			for sheet in sheets:
				paramValues.append(GetBipValue(sheet, builtInParams))
except:
	# if error accurs anywhere in the process catch it
	import traceback
	errorReport = traceback.format_exc()

#Assign your output to the OUT variable
if errorReport == None:
	OUT = paramValues
else:
	OUT = errorReport
# ----------------------------------------
VAROUT = Output(python_script)
