# Dynamo custom node AL.Get Line Style by Name.dyf (Dynamo 2.1.0.7500)
# category: Synthesize.Packages.Archi-lab_Grimshaw.Selection
# This node will return a line style object by its name. Line styles can be either Drafting or Model Line Property.

VARName = Input(VARName: var[]..[])
python_script = Python(IN[0]=VARName)
# ---------- python_script.python (56 lines) ----------
#Copyright(c) 2015, Konrad Sobon
# @arch_laboratory, http://archi-lab.net

import clr
clr.AddReference('ProtoGeometry')
from Autodesk.DesignScript.Geometry import *

# Import DocumentManager and TransactionManager
clr.AddReference("RevitServices")
import RevitServices
from RevitServices.Persistence import DocumentManager

# Import RevitAPI
clr.AddReference("RevitAPI")
import Autodesk
from Autodesk.Revit.DB import *

doc = DocumentManager.Instance.CurrentDBDocument

import sys
pyt_path = r'C:\Program Files (x86)\IronPython 2.7\Lib'
sys.path.append(pyt_path)

#The inputs to this node will be stored as a list in the IN variable.
dataEnteringNode = IN

name = IN[0]

try:
	errorReport = None
	cat = Category.GetCategory(doc, BuiltInCategory.OST_Lines)
	gs = cat.GetGraphicsStyle(GraphicsStyleType.Projection)
	gsCat = gs.GraphicsStyleCategory.SubCategories
	lineStyles = [i.GetGraphicsStyle(GraphicsStyleType.Projection) for i in gsCat]
	
	lStyle = []
	try:
		lStyle.append(next(i for i in lineStyles if name==i.Name))
	except StopIteration:
		pass
	
	if len(lStyle) != 0:
		dataOut = lStyle[0]
	else:
		message = "No Line Style with specified \nname could be found."
		dataOut = '\n'.join('{:^35}'.format(s) for s in message.split('\n'))
except:
	# if error accurs anywhere in the process catch it
	import traceback
	errorReport = traceback.format_exc()

#Assign your output to the OUT variable
if errorReport == None:
	OUT = dataOut
else:
	OUT = errorReport
# ----------------------------------------
VARLineStyle = Output(python_script)
