# Dynamo custom node AS.[&] PointList.SortAzimuthally.dyf (Dynamo 2.1.0.7500)
# category: Synthesize.Packages.Ampersand.Geometry.Point
# Sort points azimuthally (like sorting numbers around a clock face) in a plane.  Points are ordered about the origin of the plane, proceeding from the positive x-axis of the plane in a counter-clockwise direction about the plane normal vector.

VARpoints = Input(VARpoints: Autodesk.DesignScript.Geometry.Point[])
VARplane = Input(VARplane: Autodesk.DesignScript.Geometry.Plane = Autodesk.DesignScript.Geometry.Plane.XY())
origin = Plane.Origin(plane=VARplane)
byTwoPoints = Vector.ByTwoPoints(start=origin, end=VARpoints)
normalized = Vector.Normalized(vector=byTwoPoints)
as_vector_projecttoplane = Custom[AS.[&] Vector.ProjectToPlane](VARvector=normalized, VARplane=VARplane)  # Find the projection of the vector to the specified plane.
XAxis = Plane.XAxis(plane=VARplane)
cross = Vector.Cross(vector=as_vector_projecttoplane, cross=XAxis)
normal = Plane.Normal(plane=VARplane)
dot = Vector.Dot(vector=cross, vec=normal)
code_block = CodeBlock { 0; }
gt = dot > code_block
dot_2 = Vector.Dot(vector=as_vector_projecttoplane, vec=XAxis)
acos = Math.Acos(ratio=dot_2)
code_block_2 = CodeBlock(reverse=gt, theta=acos) { reverse?(360-theta):theta; }
sortByKey = List.SortByKey(list=VARpoints, keys=code_block_2)
VARpoints_2 = Output(sortByKey.sorted_list)  # "VARpoints"
VARangles = Output(sortByKey.sorted_keys)
