# Dynamo custom node AS.[&] Vector.ProjectToPlane.dyf (Dynamo 2.1.0.7500)
# category: Synthesize.Packages.Ampersand.Geometry.Vector
# Find the projection of the vector to the specified plane.

VARvector = Input(VARvector: Autodesk.DesignScript.Geometry.Vector)
VARplane = Input(VARplane: Autodesk.DesignScript.Geometry.Plane = Autodesk.DesignScript.Geometry.Plane.XY())
normal = Plane.Normal(plane=VARplane)
dot = Vector.Dot(vector=VARvector, vec=normal)
# note: Component of the vector
# perpendicular to the plane.
scale = Vector.Scale(vector=normal, scale_factor=dot)
# note: Component of the vector
# parallel to the plane.
subtract = Vector.Subtract(vector=VARvector, vectorToSubtract=scale)
VARvector_2 = Output(subtract)  # "VARvector"
