# Dynamo custom node Adaptive Component By Circle or Ellipse.dyf (Dynamo 2.1.0.7500)
# category: Synthesize.Automate.Adaptive
# Adaptive Component By Circle/Ellipse

current = Document.Current()
isFamilyDocument = Document.IsFamilyDocument(document=current)
code_block = CodeBlock { 1; 0; }
join = List.Join(list0=code_block.out0, list1=code_block.out1)
reverse = List.Reverse(list=join)
scopeIf = Custom[CW.ScopeIf+](VARtest=isFamilyDocument, VARtrue=reverse, VARfalse=join)  # A (hopefully) more robust implementation of ScopeIf. Tests a single boolean and returns a value accordingly.
join_2 = List.Join()  # unwired: list0, list1
VARelement = Input(VARelement: Revit.Elements.Element)
elementCurveReference = CurveElement.ElementCurveReference(curveElement=VARelement)
VARNumberOfElements = Input(VARNumberOfElements: var[]..[])
code_block_2 = CodeBlock { 1; }
add = VARNumberOfElements + code_block_2
sequence = Sequence(amount=add, lacing=Longest)
code_block_3 = CodeBlock { 0; 1; }
remapRange = Math.RemapRange(numbers=sequence, newMin=code_block_3.out0, newMax=code_block_3.out1)
dropLastItem = Custom[CW.List.DropLastItem](VARlist=remapRange)  # Drops the last item from a given list.
byParameterOnCurveReference = ReferencePoint.ByParameterOnCurveReference(elementCurveReference=elementCurveReference, parameter=dropLastItem)
code_block_4 = CodeBlock { 0; 0.5; }
join_3 = List.Join(list0=code_block_4.out0, list1=code_block_4.out1)
byParameterOnCurveReference_2 = ReferencePoint.ByParameterOnCurveReference(elementCurveReference=elementCurveReference, parameter=join_3)
end = Revit.Transaction.Transaction.End(input=byParameterOnCurveReference_2)
code_block_5 = CodeBlock { true; }
byReferencePoints = CurveByPoints.ByReferencePoints(points=end, isReferenceLine=code_block_5)
elementCurveReference_2 = CurveElement.ElementCurveReference(curveElement=byReferencePoints)
code_block_6 = CodeBlock { 0.5; }
byParameterOnCurveReference_3 = ReferencePoint.ByParameterOnCurveReference(elementCurveReference=elementCurveReference_2, parameter=code_block_6)
turnIntoList = Custom[CW.TurnIntoList](VARunknownItem=byParameterOnCurveReference_3)  # Turns an element (or a nested list) into a flat list
laceLongest = List.LaceLongest(comb=join_2, list1=byParameterOnCurveReference, list2=turnIntoList)
end_2 = Revit.Transaction.Transaction.End(input=laceLongest)
byReferencePoints_2 = CurveByPoints.ByReferencePoints(points=end_2, isReferenceLine=code_block_5)
elementCurveReference_3 = CurveElement.ElementCurveReference(curveElement=byReferencePoints_2)
empty = List.Empty()
curves = Element.Curves(element=VARelement)
python_script = Python(IN[0]=curves)
# ---------- python_script.python (15 lines) ----------
import clr
clr.AddReference('ProtoGeometry')
from Autodesk.DesignScript.Geometry import *
#The inputs to this node will be stored as a list in the IN variables.
dataEnteringNode = IN

inside = UnwrapElement(IN[0])

result = []

for e in inside:
	result.append(e.CenterPoint)

#Assign your output to the OUT variable.
OUT = result
# ----------------------------------------
pointAtParameter = Curve.PointAtParameter(curve=curves, param=dropLastItem, lacing=Longest)
byStartPointEndPoint = Line.ByStartPointEndPoint(startPoint=python_script, endPoint=pointAtParameter, lacing=Longest)
scopeIf_2 = Custom[CW.ScopeIf+](VARtest=isFamilyDocument, VARtrue=empty, VARfalse=byStartPointEndPoint)
byCurve = ModelCurve.ByCurve(curve=scopeIf_2)
elementCurveReference_4 = CurveElement.ElementCurveReference(curveElement=byCurve)
scopeIf_3 = Custom[CW.ScopeIf+](VARtest=isFamilyDocument, VARtrue=elementCurveReference_3, VARfalse=elementCurveReference_4)
VARfamilyType = Input(VARfamilyType: Revit.Elements.FamilyType)
byParametersOnCurveReference = AdaptiveComponent.ByParametersOnCurveReference(parameters=scopeIf, curve=scopeIf_3, familyType=VARfamilyType)
VARAdaptiveComponent = Output(byParametersOnCurveReference)
create = List.Create(item0=byParameterOnCurveReference_3, item1=byParameterOnCurveReference, item2=byParameterOnCurveReference_2, item3=byReferencePoints, item4=byReferencePoints_2)
code_block_7 = CodeBlock { false; }
clean = List.Clean(list=create, preserveIndices=code_block_7)
flatten = List.Flatten(list=clean)
VARReferencePoints = Output(flatten)
create_2 = List.Create(item0=byReferencePoints_2, item1=byReferencePoints, item2=byCurve)
code_block_8 = CodeBlock { false; }
clean_2 = List.Clean(list=create_2, preserveIndices=code_block_8)
flatten_2 = List.Flatten(list=clean_2)
VARReferenceCurve = Output(flatten_2)
