# Dynamo custom node Adaptive Match Coordination.dyf (Dynamo 2.1.0.7500)
# category: Synthesize.Automate.Adaptive
# Adaptive Match Coordination

VARElements = Input(VARElements: var[]..[])
VARSnappingTolleranceInMeters = Input(VARSnappingTolleranceInMeters: double = 0.01)
millimetersInput = Custom[MillimetersInput](VARInput=VARSnappingTolleranceInMeters)  # MetersInput
VARKeepSamePositions = Input(VARKeepSamePositions: bool = false)
python_script = Python(IN[0]=VARElements, IN[1]=millimetersInput, IN[2]=VARKeepSamePositions)
# ---------- python_script.python (274 lines) ----------
# Created By Karam Baki : karam@aecedx.com
# Enable Python support and load DesignScript library
# IMPORTANT : ALL DYNAMO DESIGN SCRIPT NODES ARE AS (dg)
import clr
clr.AddReference('ProtoGeometry')
from Autodesk.DesignScript import Geometry as dg

# EXTENSION Enable ToDSType
clr.AddReference('RevitNodes')
import Revit
clr.ImportExtensions(Revit.Elements)

# Enable Revit Elements
from Revit.Elements import *

# EXTENSION Enable Geometry Conversion Methods
clr.ImportExtensions(Revit.GeometryConversion)

# Enable Revit API
clr.AddReference('RevitAPI')
from Autodesk.Revit.DB import *

# Enable DocumentManager and TransactionManager
clr.AddReference('RevitServices')
from RevitServices.Persistence import DocumentManager
from RevitServices.Transactions import TransactionManager

# Enable ICollection List Translate
clr.AddReference("System")
import System.Collections.Generic
from System.Collections.Generic import List
from itertools import combinations

def flatten(x):
    result = []
    for el in x:
        if hasattr(el, "__iter__") and not isinstance(el, basestring):
            result.extend(flatten(el))
        else:
            result.append(el)
    return result

doc = DocumentManager.Instance.CurrentDBDocument
app = doc.Application

fam1 = UnwrapElement(IN[0])
radius = IN[1]
keepmode = IN[2]

if int(DocumentManager.Instance.CurrentUIApplication.Application.VersionNumber) < 2021:
	#radius = UnitUtils.ConvertFromInternalUnits(radius,doc.GetUnits().GetFormatOptions(UnitType.UT_Length).DisplayUnits)
	prunetol = UnitUtils.ConvertFromInternalUnits(0.0032808399,doc.GetUnits().GetFormatOptions(UnitType.UT_Length).DisplayUnits)
else:
	#radius = UnitUtils.ConvertFromInternalUnits(radius,doc.GetUnits().GetFormatOptions(SpecTypeId.Length).GetUnitTypeId())
	prunetol = UnitUtils.ConvertFromInternalUnits(0.0032808399,doc.GetUnits().GetFormatOptions(SpecTypeId.Length).GetUnitTypeId())
	
if str(DocumentManager.Instance.CurrentUIApplication.Application.SubVersionNumber) == "2022.0":
	prunetol = 0.0032808399

filteredfam1 = []
for each in fam1:
	try:
		if AdaptiveComponentInstanceUtils.IsAdaptiveComponentInstance(each) == True:
			filteredfam1.append(each)
	except:
		pass
fam1 = filteredfam1

p1lists = []
for each in fam1:
	ids1 = AdaptiveComponentInstanceUtils.GetInstancePlacementPointElementRefIds(each)
	tmpl1 = []
	for e in ids1:
		tmpl1.append(doc.GetElement(e))
	p1lists.append(tmpl1)

p1lists = flatten(p1lists)

pts = []
for each in p1lists:
	pts.append(each.GetCoordinateSystem().Origin.ToPoint())

prunedpts = dg.Point.PruneDuplicates(pts, radius)

boxes = []
for pp in prunedpts:
	minp = dg.Point.ByCoordinates((pp.X - radius),(pp.Y - radius),(pp.Z - radius))
	maxp = dg.Point.ByCoordinates((pp.X + radius),(pp.Y + radius),(pp.Z + radius))
	pbbox = dg.BoundingBox.ByCorners(minp, maxp)
	boxes.append(pbbox)
	minp.Dispose()
	maxp.Dispose()

grouped = []
groupedrefs = []

for each in boxes:
	tmp = []
	tmp2 = []
	count = 0
	for e in pts:
		if dg.BoundingBox.Contains(each,e):
			tmp.append(e)
			tmp2.append(p1lists[count])
		count = count + 1
	grouped.append(tmp)
	groupedrefs.append(tmp2)

newgrouped = []
newgroupedrefs = [] 

count = 0
for each in grouped:
	if len(each) > 1:
		newgrouped.append(each)
		newgroupedrefs.append(groupedrefs[count])
	count = count + 1

grouped = newgrouped
groupedrefs = newgroupedrefs

for each in boxes:
	each.Dispose()	

if keepmode:
	corlists = []
	reflists = []
	globalcount = 0
	for eachgroup in grouped:
		tmpgroupbase = []
		tmpgrouptran = []
		tmpref = []
		count = 0
		tmpcoor = []
		for eachpt in eachgroup:
			refp = groupedrefs[globalcount][count]
			cbase = refp.GetCoordinateSystem().ToCoordinateSystem()
			cbz = cbase.ZAxis
			ctrabase = dg.CoordinateSystem.Translate(cbase,cbz)
			cbaseorigin = cbase.Origin
			ctraorigin = ctrabase.Origin
			tmpgroupbase.append(cbaseorigin)
			tmpgrouptran.append(ctraorigin)
			tmpref.append(refp)
			count = count + 1
		try:
			try:
				polyg = dg.Polygon.ByPoints(tmpgroupbase)
				midp = polyg.Center()
				polyg.Dispose()
			except:
				try:
					pruned = dg.Point.PruneDuplicates(tmpgroupbase,prunetol)
					polyc = dg.PolyCurve.ByPoints(pruned)
					midp = dg.Curve.PointAtParameter(polyc,0.5)
					polyc.Dispose()
				except:
					midp = tmpgroupbase[0]
			try:
				polygtop = dg.Polygon.ByPoints(tmpgrouptran)
				midptop = polygtop.Center()
				polygtop.Dispose()
			except:
				prunedtop = dg.Point.PruneDuplicates(tmpgrouptran,prunetol)
				if len(prunedtop) > 1:
					polyctop = dg.PolyCurve.ByPoints(prunedtop)
					midptop = dg.Curve.PointAtParameter(polyctop,0.5)
					polyctop.Dispose()
			vec = dg.Vector.ByTwoPoints(midp, midptop)
			midptop.Dispose()
			for eachpt in eachgroup:
				plane = dg.Plane.ByOriginNormal(eachpt,vec)
				coor = dg.CoordinateSystem.ByPlane(plane)
				tmpcoor.append(coor)
			midp.Dispose()
			vec.Dispose()
			plane.Dispose()
			reflists.append(tmpref)
		except:
			pass
		globalcount = globalcount + 1
		corlists.append(tmpcoor)
	
	TransactionManager.Instance.EnsureInTransaction(doc)
	counter = 0
	for eachlist in reflists:
		try:
			minicounter = 0
			for eachref in eachlist:
				skp = SketchPlane.Create(doc, corlists[counter][minicounter].XYPlane.ToPlane()).GetPlaneReference()
				xcoor = corlists[counter][minicounter].XAxis.ToXyz()
				orcoor = corlists[counter][minicounter].Origin.ToXyz()
				dynpoints = PointOnPlane.NewPointOnPlane(doc,skp,orcoor,xcoor)
				eachref.SetPointElementReference(dynpoints)
				minicounter += 1
			counter = counter + 1
		except:
			counter = counter + 1
	TransactionManager.Instance.TransactionTaskDone()
	
	OUT = "Done, Remember to have your Adaptive Points orientation set to Host"
else:
	corlists = []
	reflists = []
	globalcount = 0
	for eachgroup in grouped:
		tmpgroupbase = []
		tmpgrouptran = []
		tmpref = []
		count = 0
		for eachpt in eachgroup:
			refp = groupedrefs[globalcount][count]
			cbase = refp.GetCoordinateSystem().ToCoordinateSystem()
			cbz = cbase.ZAxis
			ctrabase = dg.CoordinateSystem.Translate(cbase,cbz)
			cbaseorigin = cbase.Origin
			ctraorigin = ctrabase.Origin
			tmpgroupbase.append(cbaseorigin)
			tmpgrouptran.append(ctraorigin)
			tmpref.append(refp)
			count = count + 1
	
		try:
			try:
				polyg = dg.Polygon.ByPoints(tmpgroupbase)
				midp = polyg.Center()
				polyg.Dispose()
			except:
				try:
					pruned = dg.Point.PruneDuplicates(tmpgroupbase,prunetol)
					polyc = dg.PolyCurve.ByPoints(pruned)
					midp = dg.Curve.PointAtParameter(polyc,0.5)
					polyc.Dispose()
				except:
					midp = tmpgroupbase[0]
			try:
				polygtop = dg.Polygon.ByPoints(tmpgrouptran)
				midptop = polygtop.Center()
				polygtop.Dispose()
			except:
				prunedtop = dg.Point.PruneDuplicates(tmpgrouptran,prunetol)
				if len(prunedtop) > 1:
					polyctop = dg.PolyCurve.ByPoints(prunedtop)
					midptop = dg.Curve.PointAtParameter(polyctop,0.5)
					polyctop.Dispose()
			vec = dg.Vector.ByTwoPoints(midp, midptop)
			midptop.Dispose()
			plane = dg.Plane.ByOriginNormal(midp,vec)
			midp.Dispose()
			vec.Dispose()
			coor = dg.CoordinateSystem.ByPlane(plane)
			plane.Dispose()
			corlists.append(coor)
			reflists.append(tmpref)
		except:
			pass
		globalcount = globalcount + 1
	
	TransactionManager.Instance.EnsureInTransaction(doc)
	counter = 0
	for eachlist in reflists:
		try:
			skp = SketchPlane.Create(doc, corlists[counter].XYPlane.ToPlane()).GetPlaneReference()
			xcoor = corlists[counter].XAxis.ToXyz()
			orcoor = corlists[counter].Origin.ToXyz()
			dynpoints = PointOnPlane.NewPointOnPlane(doc,skp,orcoor,xcoor)
			for eachref in eachlist:
				eachref.SetPointElementReference(dynpoints)
			counter = counter + 1
		except:
			counter = counter + 1
	TransactionManager.Instance.TransactionTaskDone()
	
	OUT = "Done, Remember to have your Adaptive Points orientation set to Host"
# ----------------------------------------
VAROutput = Output(python_script)
