# Dynamo custom node AdaptiveComponent.ByParametersOnCurveReference Fixer.dyf (Dynamo 2.1.0.7500)
# category: Synthesize.Fixers
# AdaptiveComponent.ByParametersOnCurveReference Fixer

parameters = Input(parameters: double[])
curve = Input(curve: Autodesk.DesignScript.Geometry.Curve)
familyType = Input(familyType: Revit.Elements.FamilyType)
byParametersOnCurveReference = AdaptiveComponent.ByParametersOnCurveReference(parameters=parameters, curve=curve, familyType=familyType)
AdaptiveComponent = Output(byParametersOnCurveReference)
