# Dynamo custom node BK.Any Null in List.dyf (Dynamo 2.1.0.7500)
# category: Synthesize.Packages.Bakery.Core.List
# returns boolean true if a null is found

VARlist = Input(VARlist: var[]..[])
code_block = CodeBlock { null; }
bk_bv_all_indices_of_that_can = Custom[BK.bv All Indices Of that can handle Nulls](VARlist=VARlist, VARvalue=code_block)  # forked from spring nodes
count = List.Count(list=bk_bv_all_indices_of_that_can)
code_block_2 = CodeBlock { 1; }
ge = count >= code_block_2
VARbool = Output(ge)
