# Dynamo custom node BK.Convert Category Name to Built In Category Name.dyf (Dynamo 2.1.0.7500)
# category: Synthesize.Packages.Bakery.Revit.Document.Category
# You must use List.Map to convert list of Category Names to list of Built In Names

bk_get_categories_with_builtins = Custom[BK.Get Categories with Builtins]()  # Lists: Category Names, internal api definition, Built In Category Names, Ids
VARcategoryNameOrNames = Input(VARcategoryNameOrNames: var[]..[])
turnIntoList = Custom[CW.TurnIntoList](VARunknownItem=VARcategoryNameOrNames)  # Turns an element (or a nested list) into a flat list
bk_bv_if_equal_return_index = Custom[BK.bv If Equal Return Index](VARlistA=turnIntoList, VARlistB=bk_get_categories_with_builtins.VARNames)  # forked
getItemAtIndex = List.GetItemAtIndex(list=bk_get_categories_with_builtins.VARBuiltinName, index=bk_bv_if_equal_return_index)
VARbuiltInName = Output(getItemAtIndex)
