# Dynamo custom node BK.Create Parts for Linked Elements.dyf (Dynamo 2.1.0.7500)
# category: Synthesize.Packages.Bakery.Revit.Elements.Parts
# currently does not handle multiple instances of Link

VARlinkedElementList = Input(VARlinkedElementList: var[]..[])
watch = Watch(VARlinkedElementList)
VARlinkDocumentList_sameLength = Input(VARlinkDocumentList_sameLength: var[]..[])
watch_2 = Watch(VARlinkDocumentList_sameLength)
bk_get_linked_rvt_documents = Custom[BK.Get Linked RVT Documents]()
bk_if_equal_return_index_using = Custom[BK.If Equal Return Index using IndexOf](VARsearchForThese=VARlinkDocumentList_sameLength, VARinThisList=bk_get_linked_rvt_documents.VARLinkDoc)
getItemAtIndex = List.GetItemAtIndex(list=bk_get_linked_rvt_documents.VARLinkInstanceId, index=bk_if_equal_return_index_using)
watch_3 = Watch(getItemAtIndex)
count = List.Count(list=watch)
code_block = CodeBlock(x=count) { 0..x-1; }
python_script = Python(IN[0]=watch, IN[1]=watch_2, IN[2]=watch_3, IN[3]=code_block)
# ---------- python_script.python (45 lines) ----------
import clr
clr.AddReference('ProtoGeometry')
from Autodesk.DesignScript.Geometry import *
# Import ToDSType(bool) extension method
clr.AddReference("RevitNodes")
import Revit
clr.ImportExtensions(Revit.Elements)
# Import geometry conversion extension methods
clr.ImportExtensions(Revit.GeometryConversion)
# Import DocumentManager and TransactionManager
clr.AddReference("RevitServices")
import RevitServices
from RevitServices.Persistence import DocumentManager
from RevitServices.Transactions import TransactionManager
from System.Collections.Generic import *
# Import RevitAPI
clr.AddReference("RevitAPI")
import Autodesk
from Autodesk.Revit.DB import *

doc = DocumentManager.Instance.CurrentDBDocument
uiapp = DocumentManager.Instance.CurrentUIApplication
app = uiapp.Application
elemlist = UnwrapElement(IN[0])
docs = UnwrapElement(IN[1])
instId = IN[2]
counter = IN[3]
result = []
for z in counter:
	y = LinkElementId(instId[z], elemlist[z].Id)
	Ids = []
	Ids.append(y)
	IDS = List[Autodesk.Revit.DB.LinkElementId](Ids)
	TransactionManager.Instance.EnsureInTransaction(doc)
#created = []
	try:
		a=PartUtils.CreateParts(doc,IDS)
		result.append(True)
	except:
		result.append(False)

	TransactionManager.Instance.TransactionTaskDone()
#TransactionManager.Instance.ForceCloseTransaction()

OUT = result
# ----------------------------------------
VARPartscreated = Output(python_script)
