# Dynamo custom node BK.Element List check for Inplace Families.dyf (Dynamo 2.1.0.7500)
# category: Synthesize.Packages.Bakery.Revit.Elements.Family
# pythonic

VARElements = Input(VARElements: var[]..[])
python_script = Python(IN[0]=VARElements)
# ---------- python_script.python (33 lines) ----------
#Copyright(c) 2014, Jason Andersen, andersen.ja@gmail.com

# Default imports
import clr
# Import RevitAPI
clr.AddReference("RevitAPI")
import Autodesk
from Autodesk.Revit.DB import *
# Import DocumentManager and TransactionManager
clr.AddReference("RevitServices")
import RevitServices
from RevitServices.Persistence import DocumentManager
from RevitServices.Transactions import TransactionManager
# Import ToDSType(bool) extension method
clr.AddReference("RevitNodes")
import Revit
clr.ImportExtensions(Revit.Elements)
doc =  DocumentManager.Instance.CurrentDBDocument
app =  DocumentManager.Instance.CurrentUIApplication.Application

#The input to this node will be stored in the IN[0] variable.
elementz = IN[0]
        
elements = []
for e in elementz:
    elements.append(UnwrapElement(e))
    
names = []
for item in elements:
    names.append(item.Symbol.Family.IsInPlace)
    
#Assign your output to the OUT variable
OUT = names
# ----------------------------------------
flatten = List.Flatten(list=python_script)
VARFamilyInPlace = Output(flatten)
