# Dynamo custom node BK.Find Nearest Revit Level for a Given Z value.dyf (Dynamo 2.1.0.7500)
# category: Synthesize.Packages.Bakery.Geometry

categories = Categories("OST_Levels")  # graph input
all_elements_of_category = ElementsOfCategory(Category=categories)
VARzvalue = Input(VARzvalue: var[]..[])
projectElevation = Level.ProjectElevation(level=all_elements_of_category)
bk_list_of_float_double_to_list = Custom[BK.List of float double to list of Int](VARdouble=projectElevation)  # no decimals
sub = VARzvalue - bk_list_of_float_double_to_list
formula = Formula("abs(x)", x=sub)
minimumItem = List.MinimumItem(list=formula)
bk_if_equal_return_index_using = Custom[BK.If Equal Return Index using IndexOf](VARsearchForThese=minimumItem, VARinThisList=formula)
getItemAtIndex = List.GetItemAtIndex(list=all_elements_of_category, index=bk_if_equal_return_index_using)
VARnearestLevel = Output(getItemAtIndex)
