# Dynamo custom node BK.Get Link Instance and Element Ids from LinkElementId Object.dyf (Dynamo 2.1.0.7500)
# category: Synthesize.Packages.Bakery.Revit.Document.Links

VARLinkElementIds = Input(VARLinkElementIds: var[]..[])
turnIntoList = Custom[CW.TurnIntoList](VARunknownItem=VARLinkElementIds)  # Turns an element (or a nested list) into a flat list
python_script = Python(IN[0]=turnIntoList)
# ---------- python_script.python (63 lines) ----------
#python nodes in dynamo 0.7
#proposed by Julien Benoit @jbenoit44 
#http://aecuandme.wordpress.com/
import clr
clr.AddReference('ProtoGeometry')
from Autodesk.DesignScript.Geometry import *

# Import ToDSType(bool) extension method
clr.AddReference("RevitNodes")
import Revit
clr.ImportExtensions(Revit.Elements)

# Import DocumentManager and TransactionManager
clr.AddReference("RevitServices")
import RevitServices
from RevitServices.Persistence import DocumentManager
from RevitServices.Transactions import TransactionManager

from System.Collections.Generic import *

# Import RevitAPI
clr.AddReference("RevitAPI")
import Autodesk

#doc = IN[1]
doc = DocumentManager.Instance.CurrentDBDocument
uiapp = DocumentManager.Instance.CurrentUIApplication
app = uiapp.Application

#The inputs to this node will be stored as a list in the IN variable.
dataEnteringNode = IN

#unwrap all elements to use with API
elements = []
for i in IN[0]:
	elements.append(UnwrapElement(i))
	
# "Start" the transaction
#TransactionManager.Instance.EnsureInTransaction(doc)

linkinstances = list()
linkedelementids = list()
hostelementids = list()
for item in elements:
    linkinstances.append(item.LinkInstanceId)
    linkedelementids.append(item.LinkedElementId)
    hostelementids.append(item.HostElementId)
#    for source in item:#    .GetSourceElementIds():
#        sourcelist.append(source)
        
#    if len(sourcelist) < 2:
#       elementlist.append(sourcelist[0])
#   else:
#        elementlist.append(sourcelist)



# "End" the transaction
#TransactionManager.Instance.TransactionTaskDone()


#Assign your output to the OUT variable
OUT = linkinstances, linkedelementids, hostelementids
# ----------------------------------------
code_block = CodeBlock { 0; }
getItemAtIndex = List.GetItemAtIndex(list=python_script, index=code_block)
VARLinkInstanceIds = Output(getItemAtIndex)
code_block_2 = CodeBlock { 1; }
getItemAtIndex_2 = List.GetItemAtIndex(list=python_script, index=code_block_2)
VARLinkedElementIds = Output(getItemAtIndex_2)
code_block_3 = CodeBlock { 2; }
getItemAtIndex_3 = List.GetItemAtIndex(list=python_script, index=code_block_3)
VARHostElementIds = Output(getItemAtIndex_3)
