# Dynamo custom node BK.Get LinkElementIds from Parts.dyf (Dynamo 2.1.0.7500)
# category: Synthesize.Packages.Bakery.Revit.Elements.Parts

VARpartList = Input(VARpartList: var[]..[])
watch = Watch(VARpartList)
python_script = Python(IN[0]=watch)
# ---------- python_script.python (62 lines) ----------
#python nodes in dynamo 0.7
#proposed by Julien Benoit @jbenoit44 
#http://aecuandme.wordpress.com/
import clr
clr.AddReference('ProtoGeometry')
from Autodesk.DesignScript.Geometry import *

# Import ToDSType(bool) extension method
clr.AddReference("RevitNodes")
import Revit
clr.ImportExtensions(Revit.Elements)

# Import DocumentManager and TransactionManager
clr.AddReference("RevitServices")
import RevitServices
from RevitServices.Persistence import DocumentManager
from RevitServices.Transactions import TransactionManager

from System.Collections.Generic import *

# Import RevitAPI
clr.AddReference("RevitAPI")
import Autodesk

#doc = IN[1]
doc = DocumentManager.Instance.CurrentDBDocument
uiapp = DocumentManager.Instance.CurrentUIApplication
app = uiapp.Application

#The inputs to this node will be stored as a list in the IN variable.
dataEnteringNode = IN

#unwrap all elements to use with API
elements = []
for i in IN[0]:
	elements.append(UnwrapElement(i))
	
# "Start" the transaction
#TransactionManager.Instance.EnsureInTransaction(doc)

hostIdlist = list()
for item in elements:
    try:
    	hostIdlist.append(item.GetSourceElementIds())
    except:
    	hostIdlist.append(item)
#    for source in item:#    .GetSourceElementIds():
#        sourcelist.append(source)
        
#    if len(sourcelist) < 2:
#       elementlist.append(sourcelist[0])
#   else:
#        elementlist.append(sourcelist)



# "End" the transaction
#TransactionManager.Instance.TransactionTaskDone()


#Assign your output to the OUT variable
OUT = elements, hostIdlist# (elementlist)
# ----------------------------------------
code_block = CodeBlock { 1; }
getItemAtIndex = List.GetItemAtIndex(list=python_script, index=code_block)
VARallParents = Output(getItemAtIndex)
firstItem = List.FirstItem()  # unwired: list
map = List.Map(list=getItemAtIndex, f_x=firstItem)
VARfirstParentLinkElementId = Output(map)
