# Dynamo custom node BK.Get System Type List by Category Name.dyf (Dynamo 2.1.0.7500)
# category: Synthesize.Packages.Bakery.Revit.Elements.Family
# takes category name as string

bk_get_type_list_for_this = Custom[BK.Get Type List for this project]()
watch = Watch(bk_get_type_list_for_this.VARSystemTypes)
bk_bv_get_category_name = Custom[BK.bv Get Category Name](VARElements=watch)  # forked from Blackbox
VARcategoryName = Input(VARcategoryName: var[]..[])
eq = bk_bv_get_category_name == VARcategoryName
filterByBoolMask = List.FilterByBoolMask(list=watch, mask=eq)
VARTypes = Output(filterByBoolMask.in)
