# Dynamo custom node BK.List All Views.dyf (Dynamo 2.1.0.7500)
# category: Synthesize.Packages.Bakery.Revit.Views
# not including sheets

bk_get_all_views = Custom[BK.Get All Views]()  # taken from archi-lab
create = List.Create(item0=bk_get_all_views.VARRenderings)
create_2 = List.Create(item0=bk_get_all_views.VARPressureLossReports)
create_3 = List.Create(item0=bk_get_all_views.VARPanelSchedules)
create_4 = List.Create(item0=bk_get_all_views.VARWalkthroughs)
create_5 = List.Create(item0=bk_get_all_views.VARElevations)
create_6 = List.Create(item0=bk_get_all_views.VARDraftingViews)
create_7 = List.Create(item0=bk_get_all_views.VARUndefinedViews)
create_8 = List.Create(item0=bk_get_all_views.VARDetails)
create_9 = List.Create(item0=bk_get_all_views.VARLoadsReports)
create_10 = List.Create(item0=bk_get_all_views.VARCostReports)
create_11 = List.Create(item0=bk_get_all_views.VARLegends)
create_12 = List.Create(item0=bk_get_all_views.VAR3DViews)
create_13 = List.Create(item0=bk_get_all_views.VARColumnSchedules)
create_14 = List.Create(item0=bk_get_all_views.VARInternalViews)
create_15 = List.Create(item0=bk_get_all_views.VARSections)
create_16 = List.Create(item0=bk_get_all_views.VARCeilingPlans)
create_17 = List.Create(item0=bk_get_all_views.VARFloorPlans)
create_18 = List.Create(item0=bk_get_all_views.VARSchedules)
create_19 = List.Create(item0=bk_get_all_views.VARAreaPlans)
create_20 = List.Create(item0=bk_get_all_views.VAREngineeringPlans)
create_21 = List.Create(item0=bk_get_all_views.VARReports)
create_22 = List.Create(item0=create, item1=create_2, item2=create_3, item3=create_4, item4=create_5, item5=create_6, item6=create_7, item7=create_8, item8=create_9, item9=create_10, item10=create_11, item11=create_12, item12=create_13, item13=create_14, item14=create_15, item15=create_16, item16=create_17, item17=create_18, item18=create_19, item19=create_20, item20=create_21)
flatten = List.Flatten(list=create_22)
bk_bv_remove_nulls = Custom[BK.bv Remove Nulls](VARList=flatten)  # forked from Lunchbox
VARAllViews = Output(bk_bv_remove_nulls)
