# Dynamo custom node BK.Report on Inplace Families.dyf (Dynamo 2.1.0.7500)
# category: Synthesize.Packages.Bakery.Revit.Elements.Family

string = StringInput("InplaceFams")  # graph input
string_2 = StringInput("---Any Inplace Families?---")  # graph input
bk_collect_all_familyinstance = Custom[BK.Collect all FamilyInstance using Element Types]()  # should get model family instances
# note: could be cleaned up
bk_element_list_check_for = Custom[BK.Element List check for Inplace Families](VARElements=bk_collect_all_familyinstance)  # pythonic
anyTrue = Custom[CW.List.AnyTrue](VARseq=bk_element_list_check_for)  # Returns true if any item in a list of booleans is true.
string_3 = StringInput("---Number of Inplace Families?---")  # graph input
countTrue = List.CountTrue(list=bk_element_list_check_for)
string_4 = StringInput("---Show List---")  # graph input
id = Element.Id(element=bk_collect_all_familyinstance)
filterByBoolMask = List.FilterByBoolMask(list=id, mask=bk_element_list_check_for)
create = List.Create(item0=string, item1=string_2, item2=anyTrue, item3=string_3, item4=countTrue, item5=string_4, item6=filterByBoolMask.in)
flatten = List.Flatten(list=create)
string_5 = StringInput("NULL VALUE")  # graph input
replaceNull = Custom[CW.List.ReplaceNull](VARseq=flatten, VARreplacement=string_5)  # Replaces all null values within a given list with a substitute
VARflatList = Output(replaceNull)
filterByBoolMask_2 = List.FilterByBoolMask(list=bk_collect_all_familyinstance, mask=bk_element_list_check_for)
VARinplacefamilies = Output(filterByBoolMask_2.in)
