# Dynamo custom node BK.bv All Indices Of that can handle Nulls.dyf (Dynamo 2.1.0.7500)
# category: Synthesize.Packages.Bakery.Dynamo.ForkedNodes
# forked from spring nodes

VARlist = Input(VARlist: var[]..[])
VARvalue = Input(VARvalue: var[]..[])
code_block = CodeBlock(l1=VARlist, val=VARvalue)
# ---------- code_block.designscript (17 lines) ----------
def NullAllInd(l1:var[],val)
{
return = [Imperative]
{
out1 = [];
for(i in GetKeys(l1))
{
if(l1[i] == val)
{
out1 = List.AddItemToEnd(i,out1);
}
}
return = out1;
}
};

NullAllInd(l1,val);
# ----------------------------------------
VARindices = Output(code_block)
