# Dynamo custom node BK.bv Get Category Name.dyf (Dynamo 2.1.0.7500)
# category: Synthesize.Packages.Bakery.Dynamo.ForkedNodes
# forked from Blackbox

empty = List.Empty()
VARElements = Input(VARElements: var[]..[])
create = List.Create(item0=empty, item1=VARElements)
flatten = List.Flatten(list=create)
python_script = Python(IN[0]=flatten)
# ---------- python_script.python (41 lines) ----------
#Copyright(c) 2014, Jason Andersen, andersen.ja@gmail.com
import clr

# Import RevitAPI
clr.AddReference("RevitAPI")
import Autodesk
from Autodesk.Revit.DB import *

# Import DocumentManager and TransactionManager
clr.AddReference("RevitServices")
import RevitServices
from RevitServices.Persistence import DocumentManager
from RevitServices.Transactions import TransactionManager

# Import ToDSType(bool) extension method
clr.AddReference("RevitNodes")
import Revit
clr.ImportExtensions(Revit.Elements)
clr.ImportExtensions(Revit.GeometryConversion)

import clr
clr.AddReference('ProtoGeometry')
from Autodesk.DesignScript.Geometry import *

doc =  DocumentManager.Instance.CurrentDBDocument
app =  DocumentManager.Instance.CurrentUIApplication.Application


#The input to this node will be stored in the IN[0] variable.
elements = UnwrapElement(IN[0])

#variables
output = []
catName = []

for item in elements:
    #print faminst
	catName.append(item.Category.Name)  	    	
output.append(catName)

OUT = output
# ----------------------------------------
flatten_2 = List.Flatten(list=python_script)
VARCategoryName = Output(flatten_2)
