# Dynamo custom node Batch Elements Bounding Box.dyf (Dynamo 2.1.0.7500)
# category: Synthesize.Automate.Select
# Batch Elements Bounding Box

VARElements = Input(VARElements: var[]..[])
python_script = Python(IN[0]=VARElements)
# ---------- python_script.python (98 lines) ----------
# Enable Python support and load DesignScript library
# IMPORTANT : ALL DYNAMO DESIGN SCRIPT NODES ARE AS (dg)
import clr
clr.AddReference('ProtoGeometry')
from Autodesk.DesignScript import Geometry as dg

# EXTENSION Enable ToDSType
clr.AddReference('RevitNodes')
import Revit
clr.ImportExtensions(Revit.Elements)

# Enable Revit Elements
from Revit.Elements import *

# EXTENSION Enable Geometry Conversion Methods
clr.ImportExtensions(Revit.GeometryConversion)

# Enable Revit API
clr.AddReference('RevitAPI')
from Autodesk.Revit.DB import *

# Enable DocumentManager and TransactionManager
clr.AddReference('RevitServices')
from RevitServices.Persistence import DocumentManager
from RevitServices.Transactions import TransactionManager

# Enable ICollection List Translate
clr.AddReference("System")
import System.Collections.Generic
from System.Collections.Generic import List

def flatten(x):
    result = []
    for el in x:
        if hasattr(el, "__iter__") and not isinstance(el, basestring):
            result.extend(flatten(el))
        else:
            result.append(el)
    return result
    
def tolist(obj1):
	if hasattr(obj1,'__iter__'): return obj1
	else: return [obj1]

dataEnteringNode = IN
# Use UnwrapElement(IN[0]) When Translating From Dynamo to Revit
elements=tolist(UnwrapElement(IN[0]))

# Choose The Current Document
doc = DocumentManager.Instance.CurrentDBDocument
uidoc = DocumentManager.Instance.CurrentUIApplication.ActiveUIDocument
uiapp = DocumentManager.Instance.CurrentUIApplication
app = uiapp.Application

# Create Empty List
result = []
minpts = []
maxpts = []
pts = []
pX = []
pY = []
pZ = []
bboxes = []
for e in elements:
	try:
		bb = e.get_BoundingBox(None)
		protobox = bb.ToProtoType()
		bboxes.append(protobox)
		minp = protobox.MinPoint
		maxp = protobox.MaxPoint
		tmpP = []
		tmpP.append(minp)
		tmpP.append(maxp)
		pts.append(tmpP)
		for p in tmpP:
			pX.append(p.X)
			pY.append(p.Y)
			pZ.append(p.Z)
	except:
		pass
MAX_X = max(pX)
MIN_X = min(pX)
MAX_Y = max(pY)
MIN_Y = min(pY)
MAX_Z = max(pZ)
MIN_Z = min(pZ)

p1 = dg.Point.ByCoordinates(MAX_X,MAX_Y,MAX_Z)
p2 = dg.Point.ByCoordinates(MIN_X,MIN_Y,MIN_Z)

pts = flatten(pts)
for e in pts:
	e.Dispose()

boundbox = dg.BoundingBox.ByCorners(p1,p2)

#Assign your output to the OUT variable.
OUT = boundbox
# ----------------------------------------
VARBoundingBox = Output(python_script)
