# Dynamo custom node Better Geometry.ImportFromSAT.dyf (Dynamo 2.1.0.7500)
# category: Synthesize.Automate.Geometry
# Better Geometry.ImportFromSAT

VARSATFile = Input(VARSATFile: var[]..[])
python_script = Python(IN[0]=VARSATFile)
# ---------- python_script.python (49 lines) ----------
# Created By Karam Baki, karam@aecedx.com
import clr
import System

pf_path = System.Environment.GetFolderPath(System.Environment.SpecialFolder.ProgramFilesX86)
import sys
sys.path.append('%s\IronPython 2.7\Lib' %pf_path)
import random
import string

clr.AddReference('ProtoGeometry')
from Autodesk.DesignScript.Geometry import *

clr.AddReference('RevitAPI')
from Autodesk.Revit.DB import *

from Autodesk.DesignScript import Geometry as dg

clr.AddReference('RevitServices')
import RevitServices
from RevitServices.Persistence import DocumentManager
from RevitServices.Transactions import TransactionManager
doc = DocumentManager.Instance.CurrentDBDocument

clr.AddReference('RevitNodes')
import Revit

def betteimport(doc,sat,temp_path):
	try:
		geoms = dg.Geometry.ImportFromSAT(sat)
		if int(DocumentManager.Instance.CurrentUIApplication.Application.VersionNumber) < 2021:
			factor = round(UnitUtils.ConvertFromInternalUnits(3.280839895,doc.GetUnits().GetFormatOptions(UnitType.UT_Length).DisplayUnits),8) * 1000
		else:
			factor = round(UnitUtils.ConvertFromInternalUnits(3.280839895,doc.GetUnits().GetFormatOptions(SpecTypeId.Length).GetUnitTypeId()),8) * 1000
		randomname = ''.join([random.choice(string.ascii_letters + string.digits) for n in xrange(5)])
		sat_path = '%s%s.sat' % (temp_path, randomname)
		dg.Geometry.ExportToSAT(geoms,sat_path,factor)
		for g in geoms:
			g.Dispose()
		scaledgeoms = dg.Geometry.ImportFromSAT(sat_path)
		System.IO.File.Delete(sat_path)
		return scaledgeoms
	except:
		return sat

sat = UnwrapElement(IN[0])
temp_path = System.IO.Path.GetTempPath()

OUT = betteimport(doc,sat,temp_path)
# ----------------------------------------
VAROutput = Output(python_script)
