# Dynamo custom node Better Solids.dyf (Dynamo 2.1.0.7500)
# category: Synthesize.Automate.Solid
# Better Solids

VARSolids = Input(VARSolids: var[]..[])
python_script = Python(IN[0]=VARSolids)
# ---------- python_script.python (60 lines) ----------
# Enable Python support and load DesignScript library
# IMPORTANT : ALL DYNAMO DESIGN SCRIPT NODES ARE AS (dg)
import clr
clr.AddReference('ProtoGeometry')
from Autodesk.DesignScript import Geometry as dg

# EXTENSION Enable ToDSType
clr.AddReference('RevitNodes')
import Revit
clr.ImportExtensions(Revit.Elements)

# Enable Revit Elements
from Revit.Elements import *

# EXTENSION Enable Geometry Conversion Methods
clr.ImportExtensions(Revit.GeometryConversion)

# Enable Revit API
clr.AddReference('RevitAPI')
from Autodesk.Revit.DB import *

# Enable DocumentManager and TransactionManager
clr.AddReference('RevitServices')
from RevitServices.Persistence import DocumentManager
from RevitServices.Transactions import TransactionManager

# Enable ICollection List Translate
clr.AddReference("System")
import System.Collections.Generic
from System.Collections.Generic import List

def tolist(obj1):
	if hasattr(obj1,'__iter__'): return obj1
	else: return [obj1]

dataEnteringNode = IN
# Use UnwrapElement(IN[0]) When Translating From Dynamo to Revit
eachlist=UnwrapElement(tolist(IN[0]))

# Choose The Current Document
doc = DocumentManager.Instance.CurrentDBDocument
uidoc = DocumentManager.Instance.CurrentUIApplication.ActiveUIDocument
uiapp = DocumentManager.Instance.CurrentUIApplication
app = uiapp.Application

# Create Empty List
result = []

for e in eachlist:
	if e != None:
		try:
			result.append(dg.Solid.ByJoinedSurfaces([dg.PolySurface.BySolid(e)]))
		except:
			try:
				result.append(dg.PolySurface.BySolid(e))
			except:
				result.append(e)
	
# Assign your output to the OUT variable.
OUT = result
# ----------------------------------------
VARBetterSolids = Output(python_script)
