# Dynamo custom node Bounding Box Intersected Pairs Combination.dyf (Dynamo 2.1.0.7500)
# category: Synthesize.Automate.Filter
# Elements' Bounding Box Intersected Pairs Combination

VARElements = Input(VARElements: var[]..[])
code_block = CodeBlock { 2; }
combinations = List.Combinations(list=VARElements, length=code_block)
boundingBox = Element.BoundingBox(element=combinations)
firstItem = List.FirstItem(list=boundingBox@L2)
lastItem = List.LastItem(list=boundingBox@L2)
intersects = BoundingBox.Intersects(boundingBox=firstItem, other=lastItem)
filterByBoolMask = List.FilterByBoolMask(list=combinations, mask=intersects)
VARLists = Output(filterByBoolMask.in)
