# Dynamo custom node CH.AutoReturnValue.dyf (Dynamo 2.1.0.7500)
# category: Synthesize.Packages.Chynamo.Core.Actions
# Return the only item in the list or list itself if more than 1 items are in list

VARdata = Input(VARdata: var[]..[])
# note: Chynamo Package DYF by Koz Jono YEOH
# kozmosovia@hotmail.com
# Copyright(C)1994-2017 KozMos Inc.
# Copyright(C) 2011-2017 Neila Heaven Networks
# Licence: http://creativecommons.org/licenses/by-sa/4.0/
autoReturnValue = Python(IN[0]=VARdata)
# ---------- autoReturnValue.python (17 lines) ----------
import clr
clr.AddReference('ProtoGeometry')
from Autodesk.DesignScript.Geometry import *

dat = IN[0]
try:
	if dat == []:
		rtn=None
	else:
		if len(dat) == 1:
			rtn=dat[0]
		else:
			rtn=dat
except:
	rtn=dat

OUT=rtn
# ----------------------------------------
VARReturnData = Output(autoReturnValue)
