# Dynamo custom node CH.Room.GetRoomTag.dyf (Dynamo 2.1.0.7500)
# category: Synthesize.Packages.Chynamo.Revit.Room.Query
# Get Roomtags of input rooms

# note: Chynamo Package DYF by Koz Jono YEOH
# kozmosovia@hotmail.com
# Copyright(C)1994-2017 KozMos Inc.
# Copyright(C) 2011-2017 Neila Heaven Networks
# Licence: http://creativecommons.org/licenses/by-sa/4.0/
element_types = ElementTypes("SpatialElementTag")  # graph input
all_elements_of_type = ElementsOfType(element_type=element_types)
roomTagToRoom = Python(IN[0]=all_elements_of_type)
# ---------- roomTagToRoom.python (22 lines) ----------
import clr
clr.AddReference('ProtoGeometry')
from Autodesk.DesignScript.Geometry import *

clr.AddReference("RevitNodes")
import Revit
clr.ImportExtensions(Revit.Elements)
clr.ImportExtensions(Revit.GeometryConversion)

clr.AddReference("RevitAPI")
from Autodesk.Revit.DB import *

clr.AddReference("RevitServices")
import RevitServices
from RevitServices.Persistence import DocumentManager
from RevitServices.Transactions import TransactionManager
doc =  DocumentManager.Instance.CurrentDBDocument
tags=UnwrapElement(IN[0])
rooms=[]
for tag in tags:
	rooms.append(tag.Room)
OUT = rooms
# ----------------------------------------
VARroom = Input(VARroom: Revit.Elements.Room)
allIndicesOf = List.AllIndicesOf(list=roomTagToRoom, item=VARroom)
getItemAtIndex = List.GetItemAtIndex(list=all_elements_of_type, index=allIndicesOf)
autoReturnValue = Custom[CH.AutoReturnValue](VARdata=getItemAtIndex)  # Return the only item in the list or list itself if more than 1 items are in list
VARRoomTag = Output(autoReturnValue)
