# Dynamo custom node CH.Wall.GetWallType.dyf (Dynamo 2.1.0.7500)
# category: Synthesize.Packages.Chynamo.Revit.Wall.Query
# Get the walltype of wall

# note: Chynamo Package DYF by Koz Jono YEOH
# kozmosovia@hotmail.com
# Copyright(C)1994-2017 KozMos Inc.
# Copyright(C) 2011-2017 Neila Heaven Networks
# Licence: http://creativecommons.org/licenses/by-sa/4.0/
VARwall = Input(VARwall: Revit.Elements.Wall)
getWallType = Python(IN[0]=VARwall)
# ---------- getWallType.python (19 lines) ----------
import clr
clr.AddReference('RevitAPI')
from Autodesk.Revit.DB import *

clr.AddReference("RevitNodes")
import Revit
clr.ImportExtensions(Revit.Elements)

clr.AddReference("RevitServices")
import RevitServices
from RevitServices.Persistence import DocumentManager

doc = DocumentManager.Instance.CurrentDBDocument
wall=UnwrapElement(IN[0])
try: 
	rtn=wall.WallType
except:
	rtn=None
OUT = rtn
# ----------------------------------------
VARWallType = Output(getWallType)
