# Dynamo custom node CSV Read for Space Planner.dyf (Dynamo 2.1.0.7500)
# category: Synthesize.Automate.SpacePlanner
# This node reads a csv file for space planner

VARpath = Input(VARpath: var[]..[])
fromPath = FileObject(path=VARpath)  # "File.FromPath"
importCSV = Data.ImportCSV(filePath=fromPath)
string_from_object = FromObject(obj=importCSV)
string_from_array = FromArray(arr=string_from_object)
code_block = CodeBlock { "{"; }
split = String.Split(str=string_from_array, separator0=code_block)
string = StringInput("\n")  # graph input
replace = String.Replace(str=string_from_array, searchFor=code_block, replaceWith=string)
code_block_2 = CodeBlock { "}"; ""; }
replace_2 = String.Replace(str=replace, searchFor=code_block_2.out0, replaceWith=code_block_2.out1)
code_block_3 = CodeBlock { "null"; ""; }
replace_3 = String.Replace(str=replace_2, searchFor=code_block_3.out0, replaceWith=code_block_3.out1)
trimLeadingWhitespace = String.TrimLeadingWhitespace(str=replace_3)
VARstr = Output(trimLeadingWhitespace)
