# Dynamo custom node CW.+1.dyf (Dynamo 2.1.0.7500)
# category: Synthesize.Packages.Clockwork.Core.Math.Actions
# Increments a value by 1

VARdbl = Input(VARdbl: double)
code_block = CodeBlock(n=VARdbl) { n+1; }
VARdbl_2 = Output(code_block)  # "VARdbl"
