# Dynamo custom node CW.Curve.SuperJoin.dyf (Dynamo 2.1.0.7500)
# category: Synthesize.Packages.Chynamo
# Join all connected curves into Polycurves even they are intersected

# group: Input
# note: Chynamo Package DYF by Koz Jono YEOH
# kozmosovia@hotmail.com
# Copyright(C)1994-2016 KozMos Inc.
# Copyright(C) 2011-2016 Neila Heaven Networks
# Licence: http://creativecommons.org/licenses/by-sa/4.0/
VARCurves = Input(VARCurves: var[]..[])

code_block = CodeBlock(obj=VARCurves) { Flatten([obj]); }
isClosed = Curve.IsClosed(curve=code_block)
filterByBoolMask = List.FilterByBoolMask(list=code_block, mask=isClosed)
flatten = List.Flatten(list=filterByBoolMask.out)

# group: Make EndPoint-Curve List
startPoint = Curve.StartPoint(curve=flatten)
create = List.Create(item0=startPoint, item1=flatten)
transpose = List.Transpose(lists=create)
endPoint = Curve.EndPoint(curve=flatten)
create_2 = List.Create(item0=endPoint, item1=flatten)
transpose_2 = List.Transpose(lists=create_2)
join = List.Join(list0=transpose, list1=transpose_2)

transpose_3 = List.Transpose(lists=join)
firstItem = List.FirstItem(list=transpose_3)

# group: Get all end points which are intersection pionts
X = Point.X(point=firstItem)
floor = Math.Floor(number=X)
Y = Point.Y(point=firstItem)
floor_2 = Math.Floor(number=Y)
byCoordinates = Point.ByCoordinates(x=floor, y=floor_2)
pruneDuplicates = Point.PruneDuplicates(points=byCoordinates)
allIndicesOf = List.AllIndicesOf(list=byCoordinates)  # unwired: item
map = List.Map(list=pruneDuplicates, f_x=allIndicesOf)
count = List.Count()  # unwired: list
map_2 = List.Map(list=map, f_x=count)
code_block_2 = CodeBlock { 2; }
eq = map_2 == code_block_2
filterByBoolMask_2 = List.FilterByBoolMask(list=map, mask=eq)

isEmpty = List.IsEmpty(list=filterByBoolMask_2.in)
lastItem = List.LastItem(list=transpose_3)
transpose_4 = List.Transpose(lists=filterByBoolMask_2.in)
count_2 = List.Count(list=firstItem)

# group: Form the joined curve group IDs
firstItem_2 = List.FirstItem(list=transpose_4)
lastItem_2 = List.LastItem(list=transpose_4)
code_block_3 = CodeBlock(x=count_2) { x/2; }

group_the_connected_indices = Python(IN[0]=firstItem_2, IN[1]=lastItem_2, IN[2]=code_block_3)
# ---------- group_the_connected_indices.python (69 lines) ----------
# Chynamo Package DYF by Koz Jono YEOH
# kozmosovia@hotmail.com
# Copyright(c) 1994-2016 KozMos Inc.
# Copyright(c) 2011-2016 Neila Heaven Networks

# Revisions
# 20160503	V0.1Beta	Change from index "> C" to ">=C"
#						Look into both listA and listB
# 20160418	V0.1Alpha	First Release

import clr
clr.AddReference('ProtoGeometry')
from Autodesk.DesignScript.Geometry import *
dataEnteringNode = IN

A = IN[0]
B = IN[1]
C = IN[2]
listA = []
listB = []
rtn = []
rtx = []
i = 0

for abc in A:
	if abc >= C:
		abc = abc - C
	listA.append(abc)
for abc in B:
	if abc >= C:
		abc = abc - C
	listB.append(abc)
	
for abc in listA:
	grp = [listA[i], listB[i]]
	old = i
	j = 0
	for xyz in listA:
		if listA[j] == listB[i] and grp.count(listB[j]) < 1:
			grp.append(listB[j])
			i = j
		j = j+1
	j = 0
	for xyz in listB:
		if listB[j] == listA[i] and grp.count(listA[j]) < 1:
			grp.append(listA[j])
			i = j
		j = j+1
	rtn.append(grp)
	i = old + 1

rtn.sort(key = len)
rtn.reverse()

for abc in rtn:
	for xyz in rtn:
		app = 0
		for xxx in xyz:
			if abc.count(xxx) == 1:
				app = 1
		if app == 1:
			for xxx in xyz:
				if abc.count(xxx) < 1:
					abc.append(xxx)
	abc.sort()
	if rtx.count(abc) < 1:
		rtx.append(abc)

OUT = rtx
# ----------------------------------------

# group: Join the joinable curves and filter out the single curves
uniqueItems = List.UniqueItems(list=lastItem)
getItemAtIndex = List.GetItemAtIndex(list=lastItem, index=group_the_connected_indices)
flatten_2 = List.Flatten(list=getItemAtIndex)
uniqueItems_2 = List.UniqueItems(list=flatten_2)
setDifference = List.SetDifference(list1=uniqueItems, list2=uniqueItems_2)
byJoinedCurves = PolyCurve.ByJoinedCurves(curves=getItemAtIndex)
join_2 = List.Join(list0=setDifference, list1=byJoinedCurves)

scopeIf = Custom[CW.ScopeIf+](VARtest=isEmpty, VARtrue=lastItem, VARfalse=join_2)  # A (hopefully) more robust implementation of ScopeIf. Tests a single boolean and returns a value accordingly.
flatten_3 = List.Flatten(list=filterByBoolMask.in)

# group: Combine closed curves and remove Null values if there is any
join_3 = List.Join(list0=scopeIf, list1=flatten_3)
flatten_4 = List.Flatten(list=join_3)
python_script = Python(IN[0]=flatten_4)
# ---------- python_script.python (13 lines) ----------
import clr
clr.AddReference('ProtoGeometry')
from Autodesk.DesignScript.Geometry import *
#该节点的输入内容将存储为 IN 变量中的一个列表。
dataEnteringNode = IN
A = IN[0]
B = []
for abc in A:
	if abc != None:
		B.append(abc)
		
#将输出内容指定给 OUT 变量。
OUT = B
# ----------------------------------------

string = StringInput("""Chynamo Package Node:
================
Curve.SuperJion will join all joinable 
curves and return a list with existing
closed curves, individual curves and
joined curves""")  # graph input

# group: Output
VARCurvesamp_PolyCurves = Output(python_script)  # "VARCurvesamp;PolyCurves"
VARNodeInfo = Output(string)
