# Dynamo custom node CW.DividedSurface.AddIntersect.dyf (Dynamo 2.1.0.7500)
# category: Synthesize.Packages.Clockwork.Revit.Elements.DividedSurface.Actions
# Adds an intersect to a divided surface

VARdividedSurface = Input(VARdividedSurface: Revit.Elements.DividedSurface)
VARelement = Input(VARelement: var[]..[])
turnIntoList = Custom[CW.TurnIntoList](VARunknownItem=VARelement)  # Turns an element (or a nested list) into a flat list
python_script = Python(IN[0]=VARdividedSurface, IN[1]=turnIntoList)
# ---------- python_script.python (22 lines) ----------
import clr
clr.AddReference('RevitAPI')
from Autodesk.Revit.DB import *

clr.AddReference("RevitServices")
import RevitServices
from RevitServices.Persistence import DocumentManager
from RevitServices.Transactions import TransactionManager

doc = DocumentManager.Instance.CurrentDBDocument
divsurf = UnwrapElement(IN[0])
intersects = UnwrapElement(IN[1])

TransactionManager.Instance.EnsureInTransaction(doc)
for item in intersects:
	try:
		divsurf.AddIntersectionElement(item.Id)
	except:
		pass
TransactionManager.Instance.TransactionTaskDone()

OUT = divsurf
# ----------------------------------------
VARdividedSurface_2 = Output(python_script)  # "VARdividedSurface"
