# Dynamo custom node CW.Dynamo.Version.dyf (Dynamo 2.1.0.7500)
# category: Synthesize.Packages.Clockwork.Core.Application.Query
# Retrieves the version of the active Dynamo application

python_script = Python()  # graph input
# ---------- python_script.python (8 lines) ----------
import clr
from System.Reflection import Assembly
from System.Diagnostics import Process
dynamoCore = Assembly.Load("DynamoCore")
version_long = dynamoCore.GetName().Version.ToString()
version_short = version_long[:5]
proc = Process.GetCurrentProcess().ProcessName
OUT = (version_short,version_long,proc)
# ----------------------------------------
code_block = CodeBlock(seq=python_script) { seq[0]; seq[1]; seq[2]; }
versionShort = Output(code_block.out0)
versionLong = Output(code_block.out1)
platform = Output(code_block.out2)
