# Dynamo custom node CW.Element.ParameterExists.dyf (Dynamo 2.1.0.7500)
# category: Synthesize.Packages.Clockwork.Revit.Elements.Element.Query
# Checks if an element contains a parameter of a given name

VARelement = Input(VARelement: var[]..[])
turnIntoList = Custom[CW.TurnIntoList](VARunknownItem=VARelement)  # Turns an element (or a nested list) into a flat list
VARparam = Input(VARparam: string)
python_script = Python(IN[0]=turnIntoList, IN[1]=VARparam)
# ---------- python_script.python (28 lines) ----------
# This node was originally created by Andreas Dieckmann
# and only updated by Konrad K Sobon to work with Revit 2016

# Copyright(c) 2015, Konrad K Sobon
# @arch_laboratory, http://archi-lab.net

# Modified to Clockwork coding style by Andreas Dieckmann

import clr
clr.AddReference('RevitAPI')
from Autodesk.Revit.DB import *

items = UnwrapElement(IN[0])
param = IN[1]
elementList = []

for item in items:
	try:
		params = item.Parameters
		paramNames = [i.Definition.Name for i in params]
		if param in paramNames:
			elementList.append(True)
		else:
			elementList.append(False)
	except:
		elementList.append(False)

OUT = elementList
# ----------------------------------------
returnListOrSingleValue = Custom[CW.ReturnListOrSingleValue](VARunknownItem=VARelement, VARseq=python_script)  # If the unknown item is not a list but rather a single item, only the first item of the list (input "seq") will be returned.
VARbool = Output(returnListOrSingleValue)
