# Dynamo custom node CW.FamilyInstance.SetType.dyf (Dynamo 2.1.0.7500)
# category: Synthesize.Packages.Clockwork.Revit.Elements.FamilyInstance.Actions
# Changes the family type of a given family instance to the specified type

VARfamilyInstance = Input(VARfamilyInstance: var[]..[])
turnIntoList = Custom[CW.TurnIntoList](VARunknownItem=VARfamilyInstance)  # Turns an element (or a nested list) into a flat list
VARfamilyType = Input(VARfamilyType: var[]..[])
turnIntoList_2 = Custom[CW.TurnIntoList](VARunknownItem=VARfamilyType)
code_block = CodeBlock(instances=turnIntoList, types=turnIntoList_2)
# ---------- code_block.designscript (4 lines) ----------
inst = List.Count(instances);
ftypes[0] =  List.OfRepeatedItem(types[0],inst);
ftypes[1] =  types;
ftypes[inst > List.Count(types) ? 0 : 1];
# ----------------------------------------
python_script = Python(IN[0]=turnIntoList, IN[1]=code_block.out3)
# ---------- python_script.python (30 lines) ----------
import clr
clr.AddReference('RevitAPI')
from Autodesk.Revit.DB import *

clr.AddReference("RevitNodes")
import Revit
clr.ImportExtensions(Revit.Elements)

clr.AddReference("RevitServices")
import RevitServices
from RevitServices.Persistence import DocumentManager
from RevitServices.Transactions import TransactionManager

doc = DocumentManager.Instance.CurrentDBDocument
faminsts = UnwrapElement(IN[0])
famsymb = UnwrapElement(IN[1])
elementlist = list()
counter = 0

TransactionManager.Instance.EnsureInTransaction(doc)
for item in faminsts:
	try:
		item.Symbol = famsymb[counter]
		elementlist.append(item.ToDSType(True))
	except:
		emptylist = list()
	counter += 1
TransactionManager.Instance.TransactionTaskDone()

OUT = elementlist
# ----------------------------------------
returnListOrSingleValue = Custom[CW.ReturnListOrSingleValue](VARunknownItem=VARfamilyInstance, VARseq=python_script)  # If the unknown item is not a list but rather a single item, only the first item of the list (input "seq") will be returned.
VARfamilyInstance_2 = Output(returnListOrSingleValue)  # "VARfamilyInstance"
