# Dynamo custom node CW.FamilyParameter.Properties.dyf (Dynamo 2.13.1.3887)
# category: Synthesize.Packages.Clockwork.Revit.Elements.FamilyParameter.Query
# Retrieves all properties of a given family parameter. PLEASE NOTE: This node will only work in a family document!
# packages: Synthesize toolkit 12.6.3

VARfamilyParameter = Input(VARfamilyParameter: var[]..[])
turnIntoList = Custom[CW.TurnIntoList](VARunknownItem=VARfamilyParameter)  # package Synthesize toolkit; Turns an element (or a nested list) into a flat list
python_script = Python(IN[0]=turnIntoList)  # IronPython2
# ---------- python_script.python (74 lines) ----------
# Enable Python support and load DesignScript library
# IMPORTANT : ALL DYNAMO DESIGN SCRIPT NODES ARE AS (dg)
import clr
clr.AddReference('RevitNodes')
import Revit
clr.ImportExtensions(Revit.Elements)

from Revit.Elements import *
clr.AddReference('RevitAPI')
from Autodesk.Revit.DB import *

clr.AddReference('RevitServices')
from RevitServices.Persistence import DocumentManager

if int(DocumentManager.Instance.CurrentUIApplication.Application.VersionNumber) < 2021:
	oldrevit = True
else:
	oldrevit = False

params = UnwrapElement(IN[0])
pname = list()
guid = list()
pgroup = list()
ptype = list()
utype = list()
dutype = list()
stype = list()
isinstance = list()
isreporting = list()
isshared = list()
isreadonly = list()
usermodifiable = list()
formula = list()
determinedbyformula = list()
associatedparams = list()
associatedelements = list()
canassignformula = list()
for param in params:
	pname.append(param.Definition.Name)
	try:
		guid.append(param.GUID)
	except:
		guid.append('')
	pgroup.append(param.Definition.ParameterGroup)
	if oldrevit:
		utype.append(param.Definition.UnitType)
		ptype.append(param.Definition.ParameterType)
	else:
		utype.append(param.Definition.GetDataType())
		ptype.append(LabelUtils.GetLabelForSpec(param.Definition.GetDataType()))
	try:
		dutype.append(param.DisplayUnitType)
	except:
		dutype.append('')
	stype.append(param.StorageType)
	isinstance.append(param.IsInstance)
	isreporting.append(param.IsReporting)
	isshared.append(param.IsShared)
	isreadonly.append(param.IsReadOnly)
	usermodifiable.append(param.UserModifiable)
	if param.Formula == None:
		formula.append('')
	else:
		formula.append(param.Formula)
	determinedbyformula.append(param.IsDeterminedByFormula)
	assocparams = param.AssociatedParameters
	associatedparams.append(assocparams)
	assocelems = list()
	for assoc in assocparams:
		assocelems.append(assoc.Element)
	associatedelements.append(assocelems)
	canassignformula.append(param.CanAssignFormula)
	
OUT = (pname,guid,pgroup,ptype,utype,dutype,stype,isinstance,isreporting,isshared,isreadonly,usermodifiable,formula,determinedbyformula,associatedparams,canassignformula,associatedelements)
# ----------------------------------------
code_block = CodeBlock(seq=python_script)
# ---------- code_block.designscript (17 lines) ----------
seq[0];
seq[1];
seq[2];
seq[3];
seq[4];
seq[5];
seq[6];
seq[7];
seq[8];
seq[9];
seq[10];
seq[11];
seq[12];
seq[13];
seq[14];
seq[15];
seq[16];
# ----------------------------------------
returnListOrSingleValue = Custom[CW.ReturnListOrSingleValue](VARunknownItem=VARfamilyParameter, VARseq=code_block.out0)  # package Synthesize toolkit; If the unknown item is not a list but rather a single item, only the first item of the list (input "seq") will be returned.
VARName = Output(returnListOrSingleValue)
returnListOrSingleValue_2 = Custom[CW.ReturnListOrSingleValue](VARunknownItem=VARfamilyParameter, VARseq=code_block.out1)
VARGUID = Output(returnListOrSingleValue_2)
returnListOrSingleValue_3 = Custom[CW.ReturnListOrSingleValue](VARunknownItem=VARfamilyParameter, VARseq=code_block.out2)
VARGroup = Output(returnListOrSingleValue_3)
returnListOrSingleValue_4 = Custom[CW.ReturnListOrSingleValue](VARunknownItem=VARfamilyParameter, VARseq=code_block.out3)
VARType = Output(returnListOrSingleValue_4)
returnListOrSingleValue_5 = Custom[CW.ReturnListOrSingleValue](VARunknownItem=VARfamilyParameter, VARseq=code_block.out4)
VARUnitType = Output(returnListOrSingleValue_5)
returnListOrSingleValue_6 = Custom[CW.ReturnListOrSingleValue](VARunknownItem=VARfamilyParameter, VARseq=code_block.out5)
VARDisplayUnitType = Output(returnListOrSingleValue_6)
returnListOrSingleValue_7 = Custom[CW.ReturnListOrSingleValue](VARunknownItem=VARfamilyParameter, VARseq=code_block.out6)
VARStorageType = Output(returnListOrSingleValue_7)
returnListOrSingleValue_8 = Custom[CW.ReturnListOrSingleValue](VARunknownItem=VARfamilyParameter, VARseq=code_block.out7)
VARIsInstanceParameter = Output(returnListOrSingleValue_8)
returnListOrSingleValue_9 = Custom[CW.ReturnListOrSingleValue](VARunknownItem=VARfamilyParameter, VARseq=code_block.out8)
VARIsReportingParameter = Output(returnListOrSingleValue_9)
returnListOrSingleValue_10 = Custom[CW.ReturnListOrSingleValue](VARunknownItem=VARfamilyParameter, VARseq=code_block.out9)
VARIsSharedParameter = Output(returnListOrSingleValue_10)
returnListOrSingleValue_11 = Custom[CW.ReturnListOrSingleValue](VARunknownItem=VARfamilyParameter, VARseq=code_block.out10)
VARIsReadOnly = Output(returnListOrSingleValue_11)
returnListOrSingleValue_12 = Custom[CW.ReturnListOrSingleValue](VARunknownItem=VARfamilyParameter, VARseq=code_block.out15)
VARIsUserModfiable = Output(returnListOrSingleValue_12)
returnListOrSingleValue_13 = Custom[CW.ReturnListOrSingleValue](VARunknownItem=VARfamilyParameter, VARseq=code_block.out13)
VARCanBeAssignedAFormula = Output(returnListOrSingleValue_13)
returnListOrSingleValue_14 = Custom[CW.ReturnListOrSingleValue](VARunknownItem=VARfamilyParameter, VARseq=code_block.out11)
VARIsDeterminedByFormula = Output(returnListOrSingleValue_14)
returnListOrSingleValue_15 = Custom[CW.ReturnListOrSingleValue](VARunknownItem=VARfamilyParameter, VARseq=code_block.out12)
VARFormula = Output(returnListOrSingleValue_15)
code_block_2 = CodeBlock()
# ---------- code_block_2.designscript (30 lines) ----------
"not(";
"if(";
"and(";
"or(";
"sin(";
"cos(";
"tan(";
"asin(";
"acos(";
"atan(";
"sqrt(";
"log(";
"exp(";
"abs(";
"round(";
"roundup(";
"rounddown(";
"pi()";
"(";
")";
", ";
" + ";
" - ";
" * ";
" / ";
" ^ ";
" > ";
" < ";
" = ";
"-";
# ----------------------------------------
split = String.Split(string=code_block.out12, separator0=code_block_2.out0, separator1=code_block_2.out1, separator2=code_block_2.out2, separator3=code_block_2.out3, separator4=code_block_2.out4, separator5=code_block_2.out5, separator6=code_block_2.out6, separator7=code_block_2.out7, separator8=code_block_2.out8, separator9=code_block_2.out9, separator10=code_block_2.out10, separator11=code_block_2.out11, separator12=code_block_2.out12, separator13=code_block_2.out13, separator14=code_block_2.out14, separator15=code_block_2.out15, separator16=code_block_2.out16, separator17=code_block_2.out17, separator18=code_block_2.out18, separator19=code_block_2.out19, separator20=code_block_2.out20, separator21=code_block_2.out21, separator22=code_block_2.out22, separator23=code_block_2.out23, separator24=code_block_2.out24, separator25=code_block_2.out25, separator26=code_block_2.out26, separator27=code_block_2.out27, separator28=code_block_2.out28, separator29=code_block_2.out29)
contains = List.Contains(list=code_block.out0, item=split)
filterByBoolMask = List.FilterByBoolMask(list=split, mask=contains)
returnListOrSingleValue_16 = Custom[CW.ReturnListOrSingleValue](VARunknownItem=VARfamilyParameter, VARseq=filterByBoolMask.in)
VARParameterNamesInFormula = Output(returnListOrSingleValue_16)
returnListOrSingleValue_17 = Custom[CW.ReturnListOrSingleValue](VARunknownItem=VARfamilyParameter, VARseq=code_block.out16)
VARAssociatedElements = Output(returnListOrSingleValue_17)
returnListOrSingleValue_18 = Custom[CW.ReturnListOrSingleValue](VARunknownItem=VARfamilyParameter, VARseq=code_block.out14)
VARAssociatedParameters = Output(returnListOrSingleValue_18)
