# Dynamo custom node CW.Group.Members.dyf (Dynamo 2.1.0.7500)
# category: Synthesize.Packages.Clockwork.Revit.Elements.Group.Query
# Retrieves the members of a group

VARgroup = Input(VARgroup: var[]..[])
turnIntoList = Custom[CW.TurnIntoList](VARunknownItem=VARgroup)  # Turns an element (or a nested list) into a flat list
python_script = Python(IN[0]=turnIntoList)
# ---------- python_script.python (19 lines) ----------
import clr
clr.AddReference('RevitAPI')
from Autodesk.Revit.DB import *

clr.AddReference("RevitNodes")
import Revit
clr.ImportExtensions(Revit.Elements)

groups = UnwrapElement(IN[0])
elementlist = list()
for item in groups:
	try:
		memberlist = list()
		for member in item.GetMemberIds():
			memberlist.append(item.Document.GetElement(member))
		elementlist.append(memberlist)
	except:
		elementlist.append(list())
OUT = elementlist
# ----------------------------------------
returnListOrSingleValue = Custom[CW.ReturnListOrSingleValue](VARunknownItem=VARgroup, VARseq=python_script)  # If the unknown item is not a list but rather a single item, only the first item of the list (input "seq") will be returned.
VARmemberElements = Output(returnListOrSingleValue)
