# Dynamo custom node CW.Level.Plane.dyf (Dynamo 2.1.0.7500)
# category: Synthesize.Packages.Clockwork.Revit.Elements.Level.Query
# Retrieves the plane of a given level

VARlevel = Input(VARlevel: Revit.Elements.Level)
code_block = CodeBlock(l=VARlevel) { o = Autodesk.Point.ByCoordinates(0,0,l.ProjectElevation); pl = Plane.ByOriginNormal(o,Vector.ZAxis()); }
VARplane = Output(code_block.pl)
