# Dynamo custom node CW.List.AlphabeticalSequence.dyf (Dynamo 2.1.0.7500)
# category: Synthesize.Packages.Clockwork.Core.List.Create
# Creates a list of the first N letters of the alphabet  (where 1 = A, 2 = B, ... , 27 = AA, 28 = AB etc.).

VARn = Input(VARn: int)
code_block = CodeBlock(n=VARn) { 1..n; }
VARupperCase = Input(VARupperCase: bool = false)
fromNumber = Custom[CW.Character.FromNumber](VARupperCase=VARupperCase)  # Converts a number into a character (where 1 = A, 2 = B, ... , 27 = AA, 28 = AB etc.).; unwired: VARn
map = List.Map(list=code_block, f_x=fromNumber)
VARseq = Output(map)
