# Dynamo custom node CW.List.ChopByLengths.dyf (Dynamo 2.1.0.7500)
# category: Synthesize.Packages.Clockwork.Core.List.Actions
# Turns a list into a list of lists with sublists of varying lengths.

VARlengths = Input(VARlengths: var[]..[])
VARlist = Input(VARlist: var[]..[])
turnIntoList = Custom[CW.TurnIntoList](VARunknownItem=VARlengths)  # Turns an element (or a nested list) into a flat list
python_script = Python(IN[0]=VARlist, IN[1]=turnIntoList)
# ---------- python_script.python (15 lines) ----------
import clr

inputlist = IN[0]
listlengths = IN[1]
rowcounter = 0
elementlist = list()
for item in listlengths:
	itemcounter = 0
	itemlist = list()
	while itemcounter < item:
		itemlist.append(inputlist[rowcounter])
		rowcounter += 1
		itemcounter += 1
	elementlist.append(itemlist)
OUT = elementlist
# ----------------------------------------
returnListOrSingleValue = Custom[CW.ReturnListOrSingleValue](VARunknownItem=VARlengths, VARseq=python_script)  # If the unknown item is not a list but rather a single item, only the first item of the list (input "seq") will be returned.
VARlist_2 = Output(returnListOrSingleValue)  # "VARlist"
