# Dynamo custom node CW.List.FilterBySublistLength.dyf (Dynamo 2.1.0.7500)
# category: Synthesize.Packages.Clockwork.Core.List.Actions
# Filters out all sublists that do not have the specified length

VARseq = Input(VARseq: var[]..[])
count = List.Count(list=VARseq@L2)
VARlength = Input(VARlength: int)
code_block = CodeBlock(n=count, x=VARlength) { n == x; }
filterByBoolMask = List.FilterByBoolMask(list=VARseq, mask=code_block)
VARin = Output(filterByBoolMask.in)
VARout = Output(filterByBoolMask.out)
