# Dynamo custom node CW.List.IsNotEmpty.dyf (Dynamo 2.1.0.7500)
# category: Synthesize.Packages.Clockwork.Core.List.Query
# Just the inversion of the built-in Is Empty List node.

VARseq = Input(VARseq: var[]..[])
code_block = CodeBlock(seq=VARseq) { !List.IsEmpty(seq); }
VARbool = Output(code_block)
