# Dynamo custom node CW.List.SortListOfLists.dyf (Dynamo 2.1.0.7500)
# category: Synthesize.Packages.Clockwork.Core.List.Actions
# Sorts a list of lists by one of its sublists

VARseq = Input(VARseq: var[]..[])
code_block = CodeBlock(seq=VARseq) { List.Transpose(seq); }
VARsortIndex = Input(VARsortIndex: int = 0)
VARcaseInsensitive = Input(VARcaseInsensitive: bool = false)
VARorderDescending = Input(VARorderDescending: bool = false)
python_script = Python(IN[0]=code_block, IN[1]=VARsortIndex, IN[2]=VARcaseInsensitive, IN[3]=VARorderDescending)
# ---------- python_script.python (20 lines) ----------
import clr

lists = IN[0]
sortindex = int(IN[1])
caseinsensitive = IN[2]
sortdescending = IN[3]

# make sure that case-insensitive is turned of if it is not strings we're sorting
if caseinsensitive == True and isinstance(lists[0][sortindex], basestring) == False:
	caseinsensitive = False
if caseinsensitive == True:
	if sortdescending == True:
		OUT = sorted(lists, key=lambda lists:lists[sortindex].lower(), reverse=True)
	else:
		OUT = sorted(lists, key=lambda lists:lists[sortindex].lower())
else:
	if sortdescending == True:
		OUT = sorted(lists, key=lambda lists:lists[sortindex], reverse=True)
	else:
		OUT = sorted(lists, key=lambda lists:lists[sortindex])
# ----------------------------------------
code_block_2 = CodeBlock(seq=python_script) { List.Transpose(seq); }
VARseq_2 = Output(code_block_2)  # "VARseq"
