# Dynamo custom node CW.Paneling.MakeTriangles.dyf (Dynamo 2.1.0.7500)
# category: Synthesize.Packages.Clockwork.Paneling.Helpers
# Reduces each sublist to a list of three items specified by the indices in the pattern.

VARseq = Input(VARseq: var[]..[])
VARpat = Input(VARpat: var[]..[])
code_block = CodeBlock(seq=VARseq, pat=VARpat) { seq2 = List.Transpose(seq); seq3 = [seq2[pat[0]],seq2[pat[1]],seq2[pat[2]]]; List.Transpose(seq3); }
isNull = Object.IsNull()  # unwired: obj
map = List.Map(list=code_block.out2, f_x=isNull)
# note: Filter out null values
filterByBoolMask = List.FilterByBoolMask(list=code_block.out2, mask=map)
VARseq_2 = Output(filterByBoolMask.out)  # "VARseq"
