# Dynamo custom node CW.Paneling.ShiftPlacementAndReverse.dyf (Dynamo 2.1.0.7500)
# category: Synthesize.Packages.Clockwork.Paneling.Helpers
# Shifts (integer) and reverses (bool) a given list

VARreverse = Input(VARreverse: bool = false)
VARseq = Input(VARseq: var[]..[])
VARshift = Input(VARshift: int = 0)
code_block = CodeBlock(reverse=VARreverse, seq1=VARseq, shift=VARshift) { seq2 = reverse ? List.Reverse(seq1) : seq1; List.ShiftIndices(seq2,shift); }
VARseq_2 = Output(code_block.out1)  # "VARseq"
