# Dynamo custom node CW.Paneling.TriangularFlatMirrored Dynamo 2.dyf (Dynamo 2.1.0.7500)
# category: Synthesize.Packages.Clockwork.Paneling.Patterns
# Creates groups of points from a list of UVs or XYZs for the placement of triangular (diagrid) panels. The placement pattern can be reversed (boolean) and shifted (integer).

code_block = CodeBlock { [0..n]; }  # unwired: n
VARrotateGridBy90Degrees = Input(VARrotateGridBy90Degrees: bool = false)
VARseq = Input(VARseq: var[]..[])
swap = Custom[CW.UV.Swap](VARuv=VARseq)  # Swaps U and V coordinates
VARV = Input(VARV: int)
VARshiftRows = Input(VARshiftRows: bool = false)
isEvenNumber = Custom[CW.Math.IsEvenNumber](VARval=VARV)  # Checks if a number is even.
isOddNumber = Custom[CW.Math.IsOddNumber](VARval=VARV)  # Checks if a number is odd.
code_block_2 = CodeBlock(rotate=VARrotateGridBy90Degrees, seq1_swapped=swap, seq1=VARseq, V=VARV, shiftrows=VARshiftRows, is_even=isEvenNumber, is_odd=isOddNumber)
# ---------- code_block_2.designscript (19 lines) ----------
// DATA
// Rotate entire grid by 90°?
seq2 = rotate ? seq1_swapped : seq1;
// Make rows
rows = List.Sublists(seq2,0..(2*V+1),V+1);
// Odd rows
evenodd[0] = List.DropEveryNthItem(rows,2,0);
// Even rows
evenodd[1] = List.TakeEveryNthItem(rows,2,0);
// Left corners, standing & Rows, standing
evenodd[shiftrows ? 1 : 0];
// Left corners, lying & Rows, lying
evenodd[shiftrows ? 0 : 1];
// Right corners, standing
cond_rcs = (is_even && !(shiftrows)) || (is_odd && shiftrows);
evenodd[cond_rcs ? 0 : 1];
// Right corners, lying
cond_rcl = (is_even && shiftrows) || (is_odd && !(shiftrows));
evenodd[cond_rcl ? 0 : 1];
# ----------------------------------------
code_block_3 = CodeBlock(V=VARV)
# ---------- code_block_3.designscript (9 lines) ----------
// INDICES
0;
1;
2;
3;
V+1;
V+2;
V+3;
V+4;
# ----------------------------------------
VARshiftPlacementRowsLying = Input(VARshiftPlacementRowsLying: int = 0)
VARreverseRowsLying = Input(VARreverseRowsLying: bool = false)
buildTriangularSublists = Custom[CW.Paneling.BuildTriangularSublists](VARseq=code_block_2.out4@L2, VARoffset=code_block_3.out2, VARshift=VARshiftPlacementRowsLying, VARreverse=VARreverseRowsLying, VARindex0=code_block_3.out6, VARindex1=code_block_3.out1, VARindex2=code_block_3.out4)  # Creates sublists of three items each from a list based on given indices, shift and reverse settings and offset.
buildTriangularSublists_2 = Custom[CW.Paneling.BuildTriangularSublists](VARseq=code_block_2.out5@L2, VARoffset=code_block_3.out2, VARshift=VARshiftPlacementRowsLying, VARreverse=VARreverseRowsLying, VARindex0=code_block_3.out7, VARindex1=code_block_3.out2, VARindex2=code_block_3.out5)
join = List.Join(list0=buildTriangularSublists, list1=buildTriangularSublists_2)
code_block_4 = CodeBlock { 1; 3; }
flatten = List.Flatten(list=join, amt=code_block_4.out0)
filterBySublistLength = Custom[CW.List.FilterBySublistLength](VARseq=flatten, VARlength=code_block_4.out1)  # Filters out all sublists that do not have the specified length
VARrowsLying = Output(filterBySublistLength.VARin)
VARshiftPlacementRowsStanding = Input(VARshiftPlacementRowsStanding: int = 0)
VARreverseRowsStanding = Input(VARreverseRowsStanding: bool = false)
buildTriangularSublists_3 = Custom[CW.Paneling.BuildTriangularSublists](VARseq=code_block_2.out4@L2, VARoffset=code_block_3.out2, VARshift=VARshiftPlacementRowsStanding, VARreverse=VARreverseRowsStanding, VARindex0=code_block_3.out1, VARindex1=code_block_3.out6, VARindex2=code_block_3.out3)
filterBySublistLength_2 = Custom[CW.List.FilterBySublistLength](VARseq=buildTriangularSublists_3@L3, VARlength=code_block_4.out1)
count = List.Count(list=filterBySublistLength_2.VARin@L3)
code_block_5 = CodeBlock(n=count) { n-1; }
takeItems = List.TakeItems(list=filterBySublistLength_2.VARin@L3, amount=code_block_5@L1)
buildTriangularSublists_4 = Custom[CW.Paneling.BuildTriangularSublists](VARseq=code_block_2.out5@L2, VARoffset=code_block_3.out2, VARshift=VARshiftPlacementRowsStanding, VARreverse=VARreverseRowsStanding, VARindex0=code_block_3.out0, VARindex1=code_block_3.out5, VARindex2=code_block_3.out2)
filterBySublistLength_3 = Custom[CW.List.FilterBySublistLength](VARseq=buildTriangularSublists_4@L3, VARlength=code_block_4.out1)
join_2 = List.Join(list0=takeItems, list1=filterBySublistLength_3.VARin)
# note: Necessary cleanup:
# In some cases there are groups of three points that we don't want...
count_2 = List.Count(list=filterBySublistLength_3.VARin@L3)
code_block_6 = CodeBlock(n=count_2) { n-1; }
takeItems_2 = List.TakeItems(list=filterBySublistLength_3.VARin@L3, amount=code_block_6@L1)
join_3 = List.Join(list0=filterBySublistLength_2.VARin, list1=takeItems_2)
code_block_7 = CodeBlock(list1=join_2, list2=join_3, is_even=isEvenNumber) { rows_standing[0] = list1; rows_standing[1] = list2; rows_standing[is_even ? 0 : 1]; }
flatten_2 = List.Flatten(list=code_block_7.out2, amt=code_block_4.out0)
VARrowsStanding = Output(flatten_2)
code_block_8 = CodeBlock(V=VARV)
# ---------- code_block_8.designscript (9 lines) ----------
// PATTERNS
// Left corners, standing
[0,V+1,1];
// Left corners, lying
[V+2,0,V+1];
// Right corners, standing
[V-1,2*V+1,V];
// Right corners, flying
[2*V+1,V,2*V];
# ----------------------------------------
code_block_9 = CodeBlock { VARshiftPlacementLeftCornersLying : int = 0; }
code_block_10 = CodeBlock { VARreverseLeftCornersLying : bool = false; }
shiftPlacementAndReverse = Custom[CW.Paneling.ShiftPlacementAndReverse](VARseq=code_block_8.out1, VARshift=code_block_9, VARreverse=code_block_10)  # Shifts (integer) and reverses (bool) a given list
makeTriangles = Custom[CW.Paneling.MakeTriangles](VARseq=code_block_2.out5, VARpat=shiftPlacementAndReverse)  # Reduces each sublist to a list of three items specified by the indices in the pattern.
filterBySublistLength_4 = Custom[CW.List.FilterBySublistLength](VARseq=makeTriangles, VARlength=code_block_4.out1)
VARleftCornersLying = Output(filterBySublistLength_4.VARin)
code_block_11 = CodeBlock { VARshiftPlacementLeftCornersStanding : int = 0; }
code_block_12 = CodeBlock { VARreverseLeftCornersStanding : bool = false; }
shiftPlacementAndReverse_2 = Custom[CW.Paneling.ShiftPlacementAndReverse](VARseq=code_block_8.out0, VARshift=code_block_11, VARreverse=code_block_12)
makeTriangles_2 = Custom[CW.Paneling.MakeTriangles](VARseq=code_block_2.out4, VARpat=shiftPlacementAndReverse_2)
filterBySublistLength_5 = Custom[CW.List.FilterBySublistLength](VARseq=makeTriangles_2, VARlength=code_block_4.out1)
VARleftCornersStanding = Output(filterBySublistLength_5.VARin)
code_block_13 = CodeBlock { VARshiftPlacementRightCornersLying : int = 0; }
code_block_14 = CodeBlock { VARreverseRightCornersLying : bool = false; }
shiftPlacementAndReverse_3 = Custom[CW.Paneling.ShiftPlacementAndReverse](VARseq=code_block_8.out3, VARshift=code_block_13, VARreverse=code_block_14)
makeTriangles_3 = Custom[CW.Paneling.MakeTriangles](VARseq=code_block_2.out9, VARpat=shiftPlacementAndReverse_3)
filterBySublistLength_6 = Custom[CW.List.FilterBySublistLength](VARseq=makeTriangles_3, VARlength=code_block_4.out1)
VARrightCornersLying = Output(filterBySublistLength_6.VARin)
code_block_15 = CodeBlock { VARshiftPlacementRightCornersStanding : int = 0; }
code_block_16 = CodeBlock { VARreverseRightCornersStanding : bool = false; }
shiftPlacementAndReverse_4 = Custom[CW.Paneling.ShiftPlacementAndReverse](VARseq=code_block_8.out2, VARshift=code_block_15, VARreverse=code_block_16)
makeTriangles_4 = Custom[CW.Paneling.MakeTriangles](VARseq=code_block_2.out7, VARpat=shiftPlacementAndReverse_4)
filterBySublistLength_7 = Custom[CW.List.FilterBySublistLength](VARseq=makeTriangles_4, VARlength=code_block_4.out1)
VARrightCornersStanding = Output(filterBySublistLength_7.VARin)
