# Dynamo custom node CW.Point.RoundDownToPrecision.dyf (Dynamo 2.1.0.7500)
# category: Synthesize.Packages.Clockwork.Geometry.Point.Actions
# Rounds a point coordinate *down* to a specified precision

VARpoint = Input(VARpoint: var[]..[])
VARprecision = Input(VARprecision: var[]..[])
code_block = CodeBlock(po=VARpoint, pr=VARprecision) { a = [po.X,po.Y,po.Z]; ar = Math.Floor(a/pr)*pr; Autodesk.Point.ByCoordinates(ar[0],ar[1],ar[2]); }
VARpoint_2 = Output(code_block.out2)  # "VARpoint"
