# Dynamo custom node CW.Roof.SlabShapeByPoints.dyf (Dynamo 2.1.0.7500)
# category: Synthesize.Packages.Clockwork.Revit.Elements.Roof.Actions
# Transform a slab shape based on a list of XYZs. PLEASE NOTE: Will reset any previous edits on the slab shape.

VARpoints = Input(VARpoints: Autodesk.DesignScript.Geometry.Point[])
turnIntoList = Custom[CW.TurnIntoList](VARunknownItem=VARpoints)  # Turns an element (or a nested list) into a flat list
VARroof = Input(VARroof: var[]..[])
python_script = Python(IN[0]=turnIntoList, IN[1]=VARroof)
# ---------- python_script.python (26 lines) ----------
import clr
clr.AddReference('RevitAPI')
from Autodesk.Revit.DB import *

clr.AddReference("RevitNodes")
import Revit
clr.ImportExtensions(Revit.GeometryConversion)

clr.AddReference("RevitServices")
import RevitServices
from RevitServices.Persistence import DocumentManager
from RevitServices.Transactions import TransactionManager

doc = DocumentManager.Instance.CurrentDBDocument
xyzs = IN[0]
slabshape = UnwrapElement(IN[1])
successlist = list()
faillist = list()

TransactionManager.Instance.EnsureInTransaction(doc)
slabshape.SlabShapeEditor.ResetSlabShape()
for item in xyzs:
	slabshape.SlabShapeEditor.DrawPoint(item.ToXyz())
TransactionManager.Instance.TransactionTaskDone()

OUT = slabshape
# ----------------------------------------
VARroof_2 = Output(python_script)  # "VARroof"
