# Dynamo custom node CW.Room.Boundaries.dyf (Dynamo 2.1.0.7500)
# category: Synthesize.Packages.Clockwork.Revit.Elements.Room.Query
# Gets a list of all boundary elements of a given room or area

VARroom = Input(VARroom: var[]..[])
filterByBoolMask = List.FilterByBoolMask()  # unwired: list, mask
turnIntoList = Custom[CW.TurnIntoList](VARunknownItem=VARroom)  # Turns an element (or a nested list) into a flat list
version = Custom[CW.Application.Version]()  # Retrieves the name, version and build of the current Revit application.
python_script = Python(IN[0]=turnIntoList, IN[1]=version.VARVersionint)
# ---------- python_script.python (46 lines) ----------
import clr
clr.AddReference('RevitAPI')
from Autodesk.Revit.DB import *
import Autodesk

clr.AddReference("RevitNodes")
import Revit
clr.ImportExtensions(Revit.GeometryConversion)

items = UnwrapElement(IN[0])
version = IN[1]
elementlist = list()
curvelist = list()

for item in items:
	doc = item.Document
	calculator = SpatialElementGeometryCalculator(doc)
	options = Autodesk.Revit.DB.SpatialElementBoundaryOptions()
	# get boundary location from area computation settings
	boundloc = Autodesk.Revit.DB.AreaVolumeSettings.GetAreaVolumeSettings(doc).GetSpatialElementBoundaryLocation(SpatialElementType.Room)
	options.SpatialElementBoundaryLocation = boundloc
	#method #1 - get boundary segments
	blist = list()
	clist = list()
	try:
		for boundarylist in item.GetBoundarySegments(options):
			for boundary in boundarylist:
				blist.append(doc.GetElement(boundary.ElementId))
				if version > 2016:
					clist.append(boundary.GetCurve().ToProtoType())
				else:
					clist.append(boundary.Curve.ToProtoType())
	except:
		pass
	#method #2 - spatial element geometry calculator
	try:
		results = calculator.CalculateSpatialElementGeometry(item)
		for face in results.GetGeometry().Faces:
			for bface in results.GetBoundaryFaceInfo(face):
				blist.append(doc.GetElement(bface.SpatialBoundaryElement.HostElementId))
	except:
		pass	
	# write results to list
	elementlist.append(blist)
	curvelist.append(clist)
OUT = (elementlist,curvelist)
# ----------------------------------------
code_block = CodeBlock(seq=python_script) { seq[0]; seq[1]; }
isNull = Object.IsNull()  # unwired: obj
map = List.Map(list=code_block.out0, f_x=isNull)
combine = List.Combine(comb=filterByBoolMask.out, list1=code_block.out0, list2=map)
uniqueItems = List.UniqueItems()  # unwired: list
map_2 = List.Map(list=combine, f_x=uniqueItems)
returnListOrSingleValue = Custom[CW.ReturnListOrSingleValue](VARunknownItem=VARroom, VARseq=map_2)  # If the unknown item is not a list but rather a single item, only the first item of the list (input "seq") will be returned.
VARelements = Output(returnListOrSingleValue)
returnListOrSingleValue_2 = Custom[CW.ReturnListOrSingleValue](VARunknownItem=VARroom, VARseq=code_block.out1)
VARcurves = Output(returnListOrSingleValue_2)
