# Dynamo custom node CW.RoomSeparator.FromCurve.dyf (Dynamo 2.1.0.7500)
# category: Synthesize.Packages.Clockwork.Revit.Elements.ModelCurve.Create
# Creates room separation lines from geometry curves.

VARcurve = Input(VARcurve: Autodesk.DesignScript.Geometry.Curve)
turnIntoList = Custom[CW.TurnIntoList](VARunknownItem=VARcurve)  # Turns an element (or a nested list) into a flat list
VARsketchPlane = Input(VARsketchPlane: Revit.Elements.SketchPlane)
VARview = Input(VARview: var[]..[])
python_script = Python(IN[0]=turnIntoList, IN[1]=VARsketchPlane, IN[2]=VARview)
# ---------- python_script.python (30 lines) ----------
import clr
clr.AddReference('RevitAPI')
from Autodesk.Revit.DB import *

clr.AddReference("RevitNodes")
import Revit
clr.ImportExtensions(Revit.GeometryConversion)

clr.AddReference("RevitServices")
import RevitServices
from RevitServices.Persistence import DocumentManager
from RevitServices.Transactions import TransactionManager

doc = DocumentManager.Instance.CurrentDBDocument
curves = UnwrapElement(IN[0])
sketchplane = UnwrapElement(IN[1])
view = UnwrapElement(IN[2])

TransactionManager.Instance.EnsureInTransaction(doc)
curvearray = CurveArray()
for curve in curves:
	curvearray.Append(curve.ToRevitType())
doccreation = doc.Create
separatorarray = doccreation.NewRoomBoundaryLines(sketchplane, curvearray, view)
TransactionManager.Instance.TransactionTaskDone()

elementlist = list()
for item in separatorarray:
	elementlist.append(item)
OUT = elementlist
# ----------------------------------------
returnListOrSingleValue = Custom[CW.ReturnListOrSingleValue](VARunknownItem=VARcurve, VARseq=python_script)  # If the unknown item is not a list but rather a single item, only the first item of the list (input "seq") will be returned.
VARroomSeparator = Output(returnListOrSingleValue)
