# Dynamo custom node CW.Solid.ByUnion+.dyf (Dynamo 2.1.0.7500)
# category: Synthesize.Packages.Clockwork.Geometry.Solid.Create
# The OOTB node Solid.ByUnion occasionally fails when trying to merge solids with almost adjacent faces. This node will return the minimum amount of joined solids possible in such cases instead of returning null.

VARsolids = Input(VARsolids: Autodesk.DesignScript.Geometry.Solid[])
python_script = Python(IN[0]=VARsolids)
# ---------- python_script.python (18 lines) ----------
import clr
clr.AddReference('ProtoGeometry')
from Autodesk.DesignScript.Geometry import *

solids = IN[0]
OUT = [solids[0]]
solids = solids[1:]

for s in solids:
	i = 0
	unionDone = False
	while i < len(OUT):
		try:
			OUT[i] = OUT[i].Union(s)
			unionDone = True
			break
		except:	i += 1
	if not unionDone: OUT.append(s)
# ----------------------------------------
VARsolids_2 = Output(python_script)  # "VARsolids"
