# Dynamo custom node CW.Surface.Vertices.dyf (Dynamo 2.1.0.7500)
# category: Synthesize.Packages.Clockwork.Geometry.Surface.Query
# Returns all vertices of a given surface

VARSurfaces = Input(VARSurfaces: var[]..[])
turnIntoList = Custom[CW.TurnIntoList](VARunknownItem=VARSurfaces)  # Turns an element (or a nested list) into a flat list
code_block = CodeBlock(surf=turnIntoList) { surf.PerimeterCurves().StartPoint; }
returnListOrSingleValue = Custom[CW.ReturnListOrSingleValue](VARunknownItem=VARSurfaces, VARseq=code_block)  # If the unknown item is not a list but rather a single item, only the first item of the list (input "seq") will be returned.
VARVertices = Output(returnListOrSingleValue)
