# Dynamo custom node CW.UV.ConvexHull2D.dyf (Dynamo 2.1.0.7500)
# category: Synthesize.Packages.Clockwork.Geometry.UV.Actions
# Computes the convex hull of a given set of UV coordinates based on the monotone chain algorithm

VARUVs = Input(VARUVs: Autodesk.DesignScript.Geometry.UV[])
U = UV.U(uV=VARUVs)
V = UV.V(uV=VARUVs)
create = List.Create(item0=U, item1=V)
transpose = List.Transpose(lists=create)
python_script = Python(IN[0]=transpose)
# ---------- python_script.python (30 lines) ----------
import clr

# based on a script found here:
# http://en.wikibooks.org/wiki/Algorithm_Implementation/Geometry/Convex_hull/Monotone_chain#Python

points = IN[0]
#reformat points list
newpoints = list()
for pair in points:
	newpoint = (pair[0],pair[1])
	newpoints.append(newpoint)
points = sorted(set(newpoints))

def cross(o, a, b):
	return (a[0] - o[0]) * (b[1] - o[1]) - (a[1] - o[1]) * (b[0] - o[0])
 
if len(points) <= 1:
	OUT = points
else:
	lower = []
	for p in points:
		while len(lower) >= 2 and cross(lower[-2], lower[-1], p) <= 0:
			lower.pop()
		lower.append(p)
	upper = []
	for p in reversed(points):
		while len(upper) >= 2 and cross(upper[-2], upper[-1], p) <= 0:
			upper.pop()
		upper.append(p)
	OUT = lower[:-1] + upper[:-1]
# ----------------------------------------
transpose_2 = List.Transpose(lists=python_script)
code_block = CodeBlock(seq=transpose_2) { seq[0]; seq[1]; }
byCoordinates = UV.ByCoordinates(u=code_block.out0, v=code_block.out1)
VARUVs_2 = Output(byCoordinates)  # "VARUVs"
