# Dynamo custom node CW.UV.Swap.dyf (Dynamo 2.1.0.7500)
# category: Synthesize.Packages.Clockwork.Geometry.UV.Actions
# Swaps U and V coordinates

VARuv = Input(VARuv: Autodesk.DesignScript.Geometry.UV)
V = UV.V(uV=VARuv)
U = UV.U(uV=VARuv)
byCoordinates = UV.ByCoordinates(u=V, v=U)
VARuv_2 = Output(byCoordinates)  # "VARuv"
