# Dynamo custom node CW.UnitType.DisplayUnitType.dyf (Dynamo 2.1.0.7500)
# category: Synthesize.Packages.Clockwork.Revit.Elements.UnitType.Query
# Retrieves the display unit type for a given unit type.

VARunitType = Input(VARunitType: var[]..[])
python_script = Python(IN[0]=VARunitType)
# ---------- python_script.python (50 lines) ----------
import clr
clr.AddReference('RevitAPI')
from Autodesk.Revit.DB import *

clr.AddReference("RevitServices")
import RevitServices
from RevitServices.Persistence import DocumentManager

dynunittype = IN[0]

if int(DocumentManager.Instance.CurrentUIApplication.Application.VersionNumber) < 2021:
	oldrevit = True
else:
	oldrevit = False

if str(dynunittype) == 'DynamoUnits.Area':
	if oldrevit:
		unittype = UnitType.UT_Area
	else:
		unittype = SpecTypeId.UT_Area
elif str(dynunittype) == 'DynamoUnits.Length':
	if oldrevit:
		unittype = UnitType.UT_Length
	else:
		unittype = SpecTypeId.Length
elif str(dynunittype) == 'DynamoUnits.Volume':
	if oldrevit:
		unittype = UnitType.UT_Volume
	else:
		unittype = SpecTypeId.UT_Volume
else:
	unittype = null

doc = DocumentManager.Instance.CurrentDBDocument
if oldrevit:
	formatoptions = doc.GetUnits().GetFormatOptions(unittype)
	dispunits = formatoptions.DisplayUnits
	symtype = formatoptions.UnitSymbol
	if symtype == UnitSymbolType.UST_NONE:
		dispsym = 'None'
	else:
		dispsym = LabelUtils.GetLabelFor(symtype)
else:
	formatoptions = doc.GetUnits().GetFormatOptions(unittype)
	dispunits = doc.GetUnits().GetFormatOptions(SpecTypeId.Length).GetUnitTypeId()
	try:
		dispsym = LabelUtils.GetLabelForSymbol(formatoptions.GetSymbolTypeId())
	except:
		dispsym = "None"
OUT = (dispunits,dispsym)
# ----------------------------------------
code_block = CodeBlock(seq=python_script) { seq[0]; seq[1]; }
VARdisplayUnitType = Output(code_block.out0)
VARunitSymbol = Output(code_block.out1)
