# Dynamo custom node CW.Vector.IsParallelToPlane.dyf (Dynamo 2.1.0.7500)
# category: Synthesize.Packages.Clockwork.Geometry.Vector.Query
# Checks if a given vector is parallel to a given plane

VARVector = Input(VARVector: var[]..[])
VARPlane = Input(VARPlane: var[]..[])
code_block = CodeBlock(pl=VARPlane) { pl.Normal; }
isOrthogonalToVector = Custom[CW.Vector.IsOrthogonalToVector](VARVector1=VARVector, VARVector2=code_block)  # Checks if two vectors are orthogonal to each other
VARbool = Output(isOrthogonalToVector)
