# Dynamo custom node CW.View.Type.NoCeiling.dyf (Dynamo 2.1.0.7500)
# category: Synthesize.Packages.Clockwork.Revit.Views.View.Query
# Returns the type of a given view

VARview = Input(VARview: var[]..[])
turnIntoList = Custom[CW.TurnIntoList](VARunknownItem=VARview)  # Turns an element (or a nested list) into a flat list
python_script = Python(IN[0]=turnIntoList)
# ---------- python_script.python (10 lines) ----------
import clr
clr.AddReference('RevitAPI')
from Autodesk.Revit.DB import *

views = UnwrapElement(IN[0])
elementlist = list()

for view in views:
	elementlist.append(str(view.ViewType))
OUT = elementlist
# ----------------------------------------
returnListOrSingleValue = Custom[CW.ReturnListOrSingleValue](VARunknownItem=VARview, VARseq=python_script)  # If the unknown item is not a list but rather a single item, only the first item of the list (input "seq") will be returned.
code_block = CodeBlock { "FloorPlan"; "CeilingPlan"; }
replace = String.Replace(str=returnListOrSingleValue, searchFor=code_block.out1, replaceWith=code_block.out0)
VARtype = Output(replace)
