# Dynamo custom node CW.WallType.Function.dyf (Dynamo 2.1.0.7500)
# category: Synthesize.Packages.Clockwork.Revit.Elements.WallType.Query
# Retrieves the Function property of a given wall type

VARwallType = Input(VARwallType: Revit.Elements.WallType)
turnIntoList = Custom[CW.TurnIntoList](VARunknownItem=VARwallType)  # Turns an element (or a nested list) into a flat list
python_script = Python(IN[0]=turnIntoList)
# ---------- python_script.python (17 lines) ----------
import clr
clr.AddReference('RevitAPI')
from Autodesk.Revit.DB import *

clr.AddReference("RevitNodes")
import Revit
clr.ImportExtensions(Revit.Elements)

walltypes = UnwrapElement(IN[0])
functionlist = list()

for item in walltypes:
	try:
		functionlist.append(item.get_Parameter(BuiltInParameter.FUNCTION_PARAM).AsValueString())
	except:
		functionlist.append('No Wall/Function')
OUT = functionlist
# ----------------------------------------
returnListOrSingleValue = Custom[CW.ReturnListOrSingleValue](VARunknownItem=VARwallType, VARseq=python_script)  # If the unknown item is not a list but rather a single item, only the first item of the list (input "seq") will be returned.
VARfunction = Output(returnListOrSingleValue)
