# Dynamo custom node CW.Window.Rooms.dyf (Dynamo 2.1.0.7500)
# category: Synthesize.Packages.Clockwork.Revit.Elements.Window.Query
# Gets the rooms that are connected by a given window

VARwindow = Input(VARwindow: Revit.Elements.FamilyInstance)
VARphase = Input(VARphase: var[]..[])
rooms = Custom[CW.Door.Rooms](VARdoor=VARwindow, VARphase=VARphase)  # Gets the rooms that are connected by a given door
VARfromRoom = Output(rooms.VARfromRoom)
VARtoRoom = Output(rooms.VARtoRoom)
VARroomCount = Output(rooms.VARroomCount)
