# Dynamo custom node Clockwise Points Sorter.dyf (Dynamo 2.1.0.7500)
# category: Synthesize.Automate.Point
# Clockwise Points Sorter

VAROriginalPoints = Input(VAROriginalPoints: var[]..[])
VARPoints = Input(VARPoints: var[]..[])
count = List.Count(list=VARPoints@L2)
code_block = CodeBlock { 4; }
lt = count < code_block
filterByBoolMask = List.FilterByBoolMask(list=VAROriginalPoints, mask=lt)
filterByBoolMask_2 = List.FilterByBoolMask(list=VARPoints, mask=lt)
byPoints = Polygon.ByPoints(points=filterByBoolMask_2.in)
byPatch = Surface.ByPatch(closedCurve=byPoints)
normalAtPoint = Surface.NormalAtPoint(surface=byPatch, point=filterByBoolMask_2.in)
normalized = Vector.Normalized(vector=normalAtPoint)
Z = Vector.Z(vector=normalized)
code_block_2 = CodeBlock { 1; }
eq = Z == code_block_2
filterByBoolMask_3 = List.FilterByBoolMask(list=filterByBoolMask.in, mask=eq)
reverse = List.Reverse(list=filterByBoolMask_3.in@L2)
mergeByBoolMask = Custom[SP.List.MergeByBoolMask](VARIn=reverse@L2, VAROut=filterByBoolMask_3.out@L2, VARmask=eq@L2)  # Merge two lists by a boolean mask list. The true count in the mask should be the same as the length of the true list and vice versa for the false list.
byBestFitThroughPoints = Plane.ByBestFitThroughPoints(points=filterByBoolMask_2.out)
origin = Plane.Origin(plane=byBestFitThroughPoints)
byTwoPoints = Vector.ByTwoPoints(start=filterByBoolMask_2.out, end=origin)
XAxis = Plane.XAxis(plane=byBestFitThroughPoints)
normal = Plane.Normal(plane=byBestFitThroughPoints)
angleAboutAxis = Vector.AngleAboutAxis(vector=byTwoPoints, otherVector=XAxis, rotationAxis=normal)
round = Math.Round(number=angleAboutAxis)
sortByKey = List.SortByKey(list=filterByBoolMask.out@L2, keys=round@L2)
mergeByBoolMask_2 = Custom[SP.List.MergeByBoolMask](VARIn=mergeByBoolMask, VAROut=sortByKey.sorted_list, VARmask=lt)
VARSortedPoints = Output(mergeByBoolMask_2)
