# Dynamo custom node Combined Bounding Box of Elements.dyf (Dynamo 2.1.0.7500)
# category: Synthesize.Automate.Geometry
# Combined Bounding Box of Elements

VARelements = Input(VARelements: var[]..[])
python_script = Python(IN[0]=VARelements)
# ---------- python_script.python (83 lines) ----------
# Enable Python support and load DesignScript library
# IMPORTANT : ALL DYNAMO DESIGN SCRIPT NODES ARE AS (dg)
import clr
clr.AddReference('ProtoGeometry')
from Autodesk.DesignScript import Geometry as dg

# EXTENSION Enable ToDSType
clr.AddReference('RevitNodes')
import Revit
clr.ImportExtensions(Revit.Elements)

# Enable Revit Elements
from Revit.Elements import *

# EXTENSION Enable Geometry Conversion Methods
clr.ImportExtensions(Revit.GeometryConversion)

# Enable Revit API
clr.AddReference('RevitAPI')
from Autodesk.Revit.DB import *

# Enable DocumentManager and TransactionManager
clr.AddReference('RevitServices')
from RevitServices.Persistence import DocumentManager
from RevitServices.Transactions import TransactionManager

# Enable ICollection List Translate
clr.AddReference("System")
import System.Collections.Generic
from System.Collections.Generic import List

dataEnteringNode = IN
# Use UnwrapElement(IN[0]) When Translating From Dynamo to Revit
elems=UnwrapElement(IN[0])


# Choose The Current Document
doc = DocumentManager.Instance.CurrentDBDocument
uidoc = DocumentManager.Instance.CurrentUIApplication.ActiveUIDocument
uiapp = DocumentManager.Instance.CurrentUIApplication
app = uiapp.Application

# Create Empty List
result = []

for e in elems:
	try:
		result.append(e.get_BoundingBox(None).ToProtoType())
	except:
		pass

maxpts = []
minpts = []
for bbox in result:
	maxpts.append(bbox.MaxPoint)
	minpts.append(bbox.MinPoint)

max_Xs = []
max_Ys = []
max_Zs = []
for maxpt in maxpts:
	max_Xs.append(maxpt.X)
	max_Ys.append(maxpt.Y)
	max_Zs.append(maxpt.Z)
max_X = max(max_Xs)
max_Y = max(max_Ys)
max_Z = max(max_Zs)

min_Xs = []
min_Ys = []
min_Zs = []
for minpt in minpts:
	min_Xs.append(minpt.X)
	min_Ys.append(minpt.Y)
	min_Zs.append(minpt.Z)
min_X = min(min_Xs)
min_Y = min(min_Ys)
min_Z = min(min_Zs)

bigbound = dg.BoundingBox.ByCorners(dg.Point.ByCoordinates(max_X,max_Y,max_Z),dg.Point.ByCoordinates(min_X,min_Y,min_Z))

# Assign your output to the OUT variable.
OUT = bigbound
# ----------------------------------------
VAROut = Output(python_script)
