# Dynamo custom node Contour Loft Surfaces With PolyCurves Function.dyf (Dynamo 2.1.0.7500)
# category: Synthesize.Automate.Geometry
# Contour Loft Surfaces With PolyCurves Function

VARPolyCurves = Input(VARPolyCurves: var[]..[])
VARLoftSurfaces = Input(VARLoftSurfaces: var[]..[])
VARGoWithGeom = Input(VARGoWithGeom: var[]..[])
python_script = Python(IN[0]=VARPolyCurves, IN[1]=VARLoftSurfaces, IN[2]=VARGoWithGeom)
# ---------- python_script.python (154 lines) ----------
# Enable Python support and load DesignScript library
# IMPORTANT : ALL DYNAMO DESIGN SCRIPT NODES ARE AS (dg)
import clr
clr.AddReference('ProtoGeometry')
from Autodesk.DesignScript import Geometry as dg

# EXTENSION Enable ToDSType
clr.AddReference('RevitNodes')
import Revit
clr.ImportExtensions(Revit.Elements)

# Enable Revit Elements
from Revit.Elements import *

# EXTENSION Enable Geometry Conversion Methods
clr.ImportExtensions(Revit.GeometryConversion)

# Enable Revit API
clr.AddReference('RevitAPI')
from Autodesk.Revit.DB import *

# Enable DocumentManager and TransactionManager
clr.AddReference('RevitServices')
from RevitServices.Persistence import DocumentManager
from RevitServices.Transactions import TransactionManager

# Enable ICollection List Translate
clr.AddReference("System")
import System.Collections.Generic
from System.Collections.Generic import List

dataEnteringNode = IN
# Use UnwrapElement(IN[0]) When Translating From Dynamo to Revit
lines=UnwrapElement(IN[0])
surfs=UnwrapElement(IN[1])
gowithgeom=IN[2]

# Choose The Current Document
doc = DocumentManager.Instance.CurrentDBDocument
uidoc = DocumentManager.Instance.CurrentUIApplication.ActiveUIDocument
uiapp = DocumentManager.Instance.CurrentUIApplication
app = uiapp.Application

heights = []
for s in surfs:
	try:
		p1 = dg.Surface.PointAtParameter(s,0,0)
		p2 = dg.Surface.PointAtParameter(s,0,1)
		l = dg.Line.ByStartPointEndPoint(p1,p2)
		heights.append(l.Length)
		l.Dispose()
		p1.Dispose()
		p2.Dispose()
	except:
		heights.append(None)

# Create Empty List
result = []

for l in lines:
	intersects = []
	interheight = []
	counter = 0
	for s in surfs:
		height = heights[counter]
		counter += 1
		if height != None:
			if round(dg.Geometry.DistanceTo(l,s),2) < 0.01:
				intersects.append(s)
				interheight.append(height)
	try:
		minheight = min(interheight)
		result.append(minheight)
	except:
		result.append(None)

# Assign your output to the OUT variable
newlines = []
newresult = []

count = 0
for r in result:
	if r != None:
		newlines.append(lines[count])
		newresult.append(r)
	count += 1

if gowithgeom == True:
	count = 0
	z = dg.Vector.ZAxis()
	thickened = []
	voids = []
	for r in newresult:
		try:
			solid = dg.Curve.ExtrudeAsSolid(newlines[count],z,r)
			thickened.append(solid)
			tmpexp = dg.Geometry.Explode(solid)
			for e in tmpexp:
				tmpvec = dg.Surface.NormalAtParameter(e,0.5,0.5)
				if dg.Vector.IsAlmostEqualTo(tmpvec,dg.Vector.ZAxis()):
					surf = e
			voids.append(surf)
		except:
			pass
		count += 1
		
		
	unioned = dg.Solid.ByUnion(thickened)
	for t in thickened:
		t.Dispose()
		
	farheight = max(heights)*1.2
	solvoids = []
	for v in voids:
		try:
			perm = v.PerimeterCurves()[0]
			pd = perm.StartPoint
			pu = dg.Point.ByCoordinates(pd.X,pd.Y,pd.Z + farheight)
			trand = dg.Geometry.Translate(pd,z,0.1)
			line = dg.Line.ByStartPointEndPoint(trand,pu)
			status = False
			for k in voids:
				if dg.Geometry.DoesIntersect(line,k):
					status = True
					break
			perm.Dispose()
			pd.Dispose()
			trand.Dispose()
			pu.Dispose()
			line.Dispose()
			if status == True:
				solvoids.append(dg.Surface.Thicken(v,farheight,False))
		except:
			pass
	
	univoids = False
	if len(solvoids) != 0:
		univoids = dg.Solid.ByUnion(solvoids)
		for t in solvoids:
			t.Dispose()
		for v in voids:
			v.Dispose()
	
	if univoids != 0:
		finresult = dg.Solid.Difference(unioned,univoids)
		unioned.Dispose()
		univoids.Dispose()
	else:
		finresult = unioned
	
	OUT = newlines,newresult,finresult
else:
	finresult = []
	OUT = newlines,newresult,finresult
# ----------------------------------------
code_block = CodeBlock(a=python_script) { a[0]; a[1]; a[2]; }
VARPolyCurves_2 = Output(code_block.out0)  # "VARPolyCurves"
VARHeights = Output(code_block.out1)
VARSolid = Output(code_block.out2)
