# Dynamo custom node Contour Model Create With Helper Curves.dyf (Dynamo 2.1.0.7500)
# category: Synthesize.Automate.Topography
# Contour Model Create

VARSmoothLines = Input(VARSmoothLines: bool = false)
code_block = CodeBlock { false; }
VARPointsDistancing = Input(VARPointsDistancing: double = 1)
VARTopography = Input(VARTopography: var[]..[])
VARGoWithGeom = Input(VARGoWithGeom: var[]..[])
code_block_2 = CodeBlock { true; }
polySurface = Custom[ZK.Topography.PolySurface](VARTopography=VARTopography, VARFullTopo=VARGoWithGeom, VAROnlyCurves=code_block_2)  # Convert topography element to polysurface
smooth_curves = Custom[Smooth Curves](VARForceClose=code_block, VARPointsDistance=VARPointsDistancing, VARCurves=polySurface.VARPolyCurves, VARSmoothMode=VARSmoothLines)  # Smooth Curves
scopeIf = Custom[CW.ScopeIf+](VARtest=VARSmoothLines, VARtrue=smooth_curves, VARfalse=polySurface.VARPolyCurves)  # A (hopefully) more robust implementation of ScopeIf. Tests a single boolean and returns a value accordingly.
isClosed = Curve.IsClosed(curve=scopeIf)
filterByBoolMask = List.FilterByBoolMask(list=scopeIf, mask=isClosed)
python_script = Python(IN[0]=VARTopography)
# ---------- python_script.python (48 lines) ----------
# Enable Python support and load DesignScript library
# IMPORTANT : ALL DYNAMO DESIGN SCRIPT NODES ARE AS (dg)
import clr
clr.AddReference('ProtoGeometry')
from Autodesk.DesignScript import Geometry as dg

# EXTENSION Enable ToDSType
clr.AddReference('RevitNodes')
import Revit
clr.ImportExtensions(Revit.Elements)

# Enable Revit Elements
from Revit.Elements import *

# EXTENSION Enable Geometry Conversion Methods
clr.ImportExtensions(Revit.GeometryConversion)

# Enable Revit API
clr.AddReference('RevitAPI')
from Autodesk.Revit.DB import *

# Enable DocumentManager and TransactionManager
clr.AddReference('RevitServices')
from RevitServices.Persistence import DocumentManager
from RevitServices.Transactions import TransactionManager

# Enable ICollection List Translate
clr.AddReference("System")
import System.Collections.Generic
from System.Collections.Generic import List

dataEnteringNode = IN
# Use UnwrapElement(IN[0]) When Translating From Dynamo to Revit
topo=UnwrapElement(IN[0])

# Choose The Current Document
doc = DocumentManager.Instance.CurrentDBDocument
uidoc = DocumentManager.Instance.CurrentUIApplication.ActiveUIDocument
uiapp = DocumentManager.Instance.CurrentUIApplication
app = uiapp.Application

# Create Empty List
result = []
points = Architecture.TopographySurface.GetBoundaryPoints(topo)
for each in points:
	result.append(each.ToPoint())
# Assign your output to the OUT variable.
OUT = result
# ----------------------------------------
pruneDuplicates = Point.PruneDuplicates(points=python_script)
byPoints = Polygon.ByPoints(points=pruneDuplicates)
VARHelperCurves = Input(VARHelperCurves: var[]..[])
curves = Element.Curves(element=VARHelperCurves)
flatten = List.Flatten(list=curves)
byJoinedCurves = PolyCurve.ByJoinedCurves(curves=flatten)
byPatch = Surface.ByPatch(closedCurve=byJoinedCurves)
pointAtParameter = Surface.PointAtParameter(surface=byPatch)
byOriginNormal = Plane.ByOriginNormal(origin=pointAtParameter)
pullOntoPlane = Curve.PullOntoPlane(curve=byPoints, plane=byOriginNormal)
explode = Geometry.Explode(geometry=pullOntoPlane)
startPoint = Curve.StartPoint(curve=explode)
sort_geometry_by_guides = Custom[Sort Geometry By Guides](VARGeometries=startPoint, VARGuides=byJoinedCurves)  # Sort Loft Profiles According to Guide
as_list_sortbykey = Custom[AS.[&] List.SortByKey](VARlist=pruneDuplicates, VARkeys=sort_geometry_by_guides.VARKeys)  # Sort a list (or lists) according to the order specified by the key list.
code_block_3 = CodeBlock { true; }
byPoints_2 = PolyCurve.ByPoints(points=as_list_sortbykey.VARsortedlist, connectLastToFirst=code_block_3)
join = List.Join()  # unwired: list0, list1
startPoint_2 = Curve.StartPoint(curve=filterByBoolMask.out)
endPoint = Curve.EndPoint(curve=filterByBoolMask.out)
combine = List.Combine(comb=join, list1=startPoint_2, list2=endPoint)
doesIntersect = Geometry.DoesIntersect(geometry=byPoints_2, other=combine, lacing=Longest)
allTrue = List.AllTrue(list=doesIntersect@L2)
filterByBoolMask_2 = List.FilterByBoolMask(list=filterByBoolMask.out, mask=allTrue)
isEmpty = List.IsEmpty(list=filterByBoolMask_2.out)
VARIsThereProblem = Output(isEmpty)
curves_2 = PolyCurve.Curves(polyCurve=byPoints_2)
boundingBox = Element.BoundingBox(element=VARTopography)
toCuboid = BoundingBox.ToCuboid(boundingBox=boundingBox)
explode_2 = Geometry.Explode(geometry=toCuboid)
filterByOrientation = Custom[CW.Surface.FilterByOrientation](VARsurfaces=explode_2)  # Sorts surfaces in three lists based on their orientation (vertical, horizontal up & horizontal down) and also returns three corresponding lists of booleans.
pointAtParameter_2 = Surface.PointAtParameter(surface=filterByOrientation.VARhorizontalDown)
XYZ = Custom[LF.Point.XYZ](VARpoint=pointAtParameter_2)  # Get the X, Y, and Z components of a Point
extra_depth = DoubleInput(-5)  # graph input
add = XYZ.VARZ + extra_depth
code_block_4 = CodeBlock(a=add) { a[0]; }
byCoordinates = Point.ByCoordinates(z=code_block_4)
byOriginNormal_2 = Plane.ByOriginNormal(origin=byCoordinates)
pullOntoPlane_2 = Curve.PullOntoPlane(curve=curves_2, plane=byOriginNormal_2)
byJoinedCurves_2 = PolyCurve.ByJoinedCurves(curves=pullOntoPlane_2)
byPatch_2 = Surface.ByPatch(closedCurve=byJoinedCurves_2)
join_2 = List.Join()  # unwired: list0, list1
VARSegmentLines = Input(VARSegmentLines: bool = false)
VARProceed = Input(VARProceed: var[]..[])
create = List.Create(item0=filterByBoolMask.in, item1=filterByBoolMask_2.in)
code_block_5 = CodeBlock { false; }
clean = List.Clean(list=create, preserveIndices=code_block_5)
flatten_2 = List.Flatten(list=clean)
empty = List.Empty()
scopeIf_2 = Custom[CW.ScopeIf+](VARtest=VARProceed, VARtrue=flatten_2, VARfalse=empty)
length = Curve.Length(curve=scopeIf_2)
VARSegmentsDistance = Input(VARSegmentsDistance: double = 1)
div = length / VARSegmentsDistance
floor = Math.Floor(number=div)
VARMinimumSegments = Input(VARMinimumSegments: var[]..[])
lt = _ < VARMinimumSegments  # unwired: x
replaceByCondition = Replace(item=floor, replaceWith=VARMinimumSegments, condition=lt)
sequence = Sequence(amount=replaceByCondition, lacing=Longest)
code_block_6 = CodeBlock { 0; 1; }
remapRange = Math.RemapRange(numbers=sequence, newMin=code_block_6.out0, newMax=code_block_6.out1)
pointAtParameter_3 = Curve.PointAtParameter(curve=scopeIf_2, param=remapRange)
byPoints_3 = PolyCurve.ByPoints(points=pointAtParameter_3)
scopeIf_3 = Custom[CW.ScopeIf+](VARtest=VARSegmentLines, VARtrue=byPoints_3, VARfalse=scopeIf_2)
code_block_7 = CodeBlock { -1; }
byCoordinates_2 = Vector.ByCoordinates(z=code_block_7)
abs = Math.Abs(number=code_block_4)
code_block_8 = CodeBlock(a=abs) { a*2; }
translate = Geometry.Translate(geometry=byCoordinates, direction=byCoordinates_2, distance=code_block_8)
byOriginNormal_3 = Plane.ByOriginNormal(origin=translate)
pullOntoPlane_3 = Curve.PullOntoPlane(curve=scopeIf_3, plane=byOriginNormal_3)
combine_2 = List.Combine(comb=join_2, list1=scopeIf_3, list2=pullOntoPlane_3)
byLoft = Surface.ByLoft(crossSections=combine_2)
as_geometry_splitbytools = Custom[AS.[&] Geometry.SplitByTools](VARgeometry=byPatch_2, VARtools=byLoft)  # Split one piece of geometry (other than a polysurface) by multiple tools
perimeterCurves = Surface.PerimeterCurves(surface=as_geometry_splitbytools)
as_polycurve_bycurves = Custom[AS.[&] PolyCurve.ByCurves](VARcurves=perimeterCurves)  # Create polycurves from an unordered list of curves.
flatten_3 = List.Flatten(list=as_polycurve_bycurves.VARpolyCurve)
pullOntoPlane_4 = Curve.PullOntoPlane(curve=scopeIf_3, plane=byOriginNormal_2)
combine_3 = List.Combine(comb=join_2, list1=scopeIf_3, list2=pullOntoPlane_4)
byLoft_2 = Surface.ByLoft(crossSections=combine_3)
contour_loft_surfaces_with = Custom[Contour Loft Surfaces With PolyCurves Function](VARPolyCurves=flatten_3, VARLoftSurfaces=byLoft_2, VARGoWithGeom=VARGoWithGeom)  # Contour Loft Surfaces With PolyCurves Function
VARCurves = Output(contour_loft_surfaces_with.VARPolyCurves)
VARHeights = Output(contour_loft_surfaces_with.VARHeights)
VARSolid = Output(contour_loft_surfaces_with.VARSolid)
