# Dynamo custom node Contour Model Lines.dyf (Dynamo 2.1.0.7500)
# category: Synthesize.Automate.Topography
# Contour Model Lines

VARSolid = Input(VARSolid: var[]..[])
firstItem = List.FirstItem(list=VARSolid)
boundingBox = Geometry.BoundingBox(geometry=firstItem)
toCuboid = BoundingBox.ToCuboid(boundingBox=boundingBox)
explode = Geometry.Explode(geometry=toCuboid)
filterByOrientation = Custom[CW.Surface.FilterByOrientation](VARsurfaces=explode)  # Sorts surfaces in three lists based on their orientation (vertical, horizontal up & horizontal down) and also returns three corresponding lists of booleans.
code_block = CodeBlock { 0.5; }
pointAtParameter = Surface.PointAtParameter(surface=filterByOrientation.VARhorizontalUp, u=code_block, v=code_block)
byOriginNormal = Plane.ByOriginNormal(origin=pointAtParameter)
code_block_2 = CodeBlock { 0; }
pointAtParameter_2 = Surface.PointAtParameter(surface=filterByOrientation.VARhorizontalDown, u=code_block, v=code_block)
byStartPointEndPoint = Line.ByStartPointEndPoint(startPoint=pointAtParameter, endPoint=pointAtParameter_2)
length = Curve.Length(curve=byStartPointEndPoint)
VARContourLineInterval = Input(VARContourLineInterval: var[]..[])
div = length / VARContourLineInterval
ceiling = Math.Ceiling(number=div)
sequence = Sequence(start=code_block_2, amount=ceiling, step=VARContourLineInterval, lacing=Longest)
code_block_3 = CodeBlock { -1; }
mul = sequence * code_block_3
offset = Plane.Offset(plane=byOriginNormal, dist=mul)
code_block_4 = CodeBlock(a=offset) { a[0]; }
intersect = Geometry.Intersect(geometry=firstItem, other=code_block_4@L1)
code_block_5 = CodeBlock { false; }
clean = List.Clean(list=intersect, preserveIndices=code_block_5)
perimeterCurves = Surface.PerimeterCurves(surface=clean)
as_polycurve_bycurves = Custom[AS.[&] PolyCurve.ByCurves](VARcurves=perimeterCurves)  # Create polycurves from an unordered list of curves.
flatten = List.Flatten(list=as_polycurve_bycurves.VARpolyCurve@L3)
code_block_6 = CodeBlock { 30; }
byAngle = Custom[CurveLoop.Simplify.ByAngle](VARPolycurves=flatten@L2, VARSafeAngle=code_block_6)  # CurveLoop.Simplify.ByAngle
code_block_7 = CodeBlock { false; }
clean_2 = List.Clean(list=byAngle, preserveIndices=code_block_7)
numberOfCurves = PolyCurve.NumberOfCurves(polyCurve=clean_2)
code_block_8 = CodeBlock { 1; }
eq = numberOfCurves == code_block_8
filterByBoolMask = List.FilterByBoolMask(list=clean_2, mask=eq)
isClosed = Curve.IsClosed(curve=filterByBoolMask.out)
filterByBoolMask_2 = List.FilterByBoolMask(list=filterByBoolMask.out, mask=isClosed)
closeWithLine = PolyCurve.CloseWithLine(polyCurve=filterByBoolMask_2.out)
mergeByBoolMask = Custom[SP.List.MergeByBoolMask](VARIn=filterByBoolMask_2.in, VAROut=closeWithLine, VARmask=isClosed)  # Merge two lists by a boolean mask list. The true count in the mask should be the same as the length of the true list and vice versa for the false list.
reverse = List.Reverse(list=mergeByBoolMask)
code_block_9 = CodeBlock { 0; }
ZAxis = Vector.ZAxis()
extrude = Curve.Extrude(curve=reverse, direction=ZAxis)
byGeometry = BoundingBox.ByGeometry(geom=extrude, lacing=Longest)
dimensions = Custom[ZK.BoundingBox.Dimensions](VARBoundingBox=byGeometry)  # Input Bounding Box element to get its dimensions (Width, Length, Height). Setting Boolean switch to True rounds output values.
VARSpacing = Input(VARSpacing: var[]..[])
add = dimensions.VARWidth + VARSpacing
lb_lunchbox_mass_addition = Custom[LB.LunchBox Mass Addition](VARNumbers=add)  # Returns the total value of a list of numbers.
addItemToFront = List.AddItemToFront(item=code_block_9, list=lb_lunchbox_mass_addition.VARPartials)
code_block_10 = CodeBlock { -1; }
dropItems = List.DropItems(list=addItemToFront, amount=code_block_10)
translate = Geometry.Translate(geometry=reverse, xTranslation=dropItems)
byOriginNormal_2 = Plane.ByOriginNormal()
pullOntoPlane = Curve.PullOntoPlane(curve=translate, plane=byOriginNormal_2)
as_polycurve_bycurves_2 = Custom[AS.[&] PolyCurve.ByCurves](VARcurves=pullOntoPlane)
closeWithLine_2 = PolyCurve.CloseWithLine(polyCurve=as_polycurve_bycurves_2.VARpolyCurve)
curves = PolyCurve.Curves(polyCurve=closeWithLine_2)
flatten_2 = List.Flatten(list=curves)
code_block_11 = CodeBlock { false; }
clean_3 = List.Clean(list=flatten_2, preserveIndices=code_block_11)
VARDraftingViewName = Input(VARDraftingViewName: var[]..[])
code_block_12 = CodeBlock { false; }
clean_4 = List.Clean(list=VARDraftingViewName, preserveIndices=code_block_12)
flatten_3 = List.Flatten(list=clean_4)
byName = DraftingView.ByName(name=flatten_3)
firstItem_2 = List.FirstItem(list=byName)
python_script = Python(IN[0]=clean_3, IN[1]=firstItem_2)
# ---------- python_script.python (28 lines) ----------
import clr
clr.AddReference('RevitAPI')
from Autodesk.Revit.DB import *

clr.AddReference("RevitNodes")
import Revit
clr.ImportExtensions(Revit.GeometryConversion)

clr.AddReference("RevitServices")
import RevitServices
from RevitServices.Persistence import DocumentManager
from RevitServices.Transactions import TransactionManager

doc = DocumentManager.Instance.CurrentDBDocument
curves = UnwrapElement(IN[0])
view = UnwrapElement(IN[1])
elementlist = []

TransactionManager.Instance.EnsureInTransaction(doc)
if doc.IsFamilyDocument: 
	doc_create = doc.FamilyCreate
else: 
	doc_create = doc.Create
for curve in curves:
	detcurve = doc_create.NewDetailCurve(view, curve.ToRevitType())
	elementlist.append(detcurve)
TransactionManager.Instance.TransactionTaskDone()
OUT = elementlist
# ----------------------------------------
VARDetailCurve = Output(python_script)
VARDraftingView = Output(firstItem_2)
