# Dynamo custom node Coordinate System Adaptive Divided Path Prepare.dyf (Dynamo 2.1.0.7500)
# category: Synthesize.Automate.Adaptive
# Coordinate System Adaptive Divided Path Prepare

VARDividedPaths = Input(VARDividedPaths: var[]..[])
turnIntoList = Custom[CW.TurnIntoList](VARunknownItem=VARDividedPaths)  # Turns an element (or a nested list) into a flat list
code_block = CodeBlock { "DividedPath"; }
byClassName = Custom[SP.Filter.ByClassName](VARobject=turnIntoList, VARclassName=code_block)  # Filters a list of objects by the object's class name. Note that Dynamo elements belong to different classes than their Revit counterparts. Use the Object.Class node to check an object's class.
points = DividedPath.Points(dividedPath=byClassName.VARin)
code_block_2 = CodeBlock { 1; }
byCoordinates = Vector.ByCoordinates(z=code_block_2)
planes_and_curve_of_divided_path = Custom[Planes and Curve of Divided Path](VARDividedPaths=byClassName.VARin)  # Planes and Curve of Divided Path
count = List.Count(list=points@L2)
code_block_3 = CodeBlock(a=count) { i=Math.Ceiling((a-1)/2); }
getItemAtIndex = List.GetItemAtIndex(list=points@L2, index=code_block_3, lacing=Longest)
count_2 = List.Count(list=getItemAtIndex)
ofRepeatedItem = List.OfRepeatedItem(item=planes_and_curve_of_divided_path.VARCurves, amount=count_2)
doesIntersect = Geometry.DoesIntersect(geometry=getItemAtIndex@L1, other=planes_and_curve_of_divided_path.VARCurves)
filterByBoolMask = List.FilterByBoolMask(list=ofRepeatedItem, mask=doesIntersect)
firstItem = List.FirstItem(list=filterByBoolMask.in@L2)
parameterAtPoint = Curve.ParameterAtPoint(curve=firstItem, point=points)
tangentAtParameter = Curve.TangentAtParameter(curve=firstItem, param=parameterAtPoint)
VARRotationDegree = Input(VARRotationDegree: double = 0)
rotate = Vector.Rotate(vector=byCoordinates, axis=tangentAtParameter, degrees=VARRotationDegree)
byOriginNormalXAxis = Plane.ByOriginNormalXAxis(origin=points, normal=rotate, xAxis=tangentAtParameter)
XAxis = Plane.XAxis(plane=byOriginNormalXAxis)
YAxis = Plane.YAxis(plane=byOriginNormalXAxis)
byOriginVectors = CoordinateSystem.ByOriginVectors(origin=points, xAxis=XAxis, yAxis=YAxis)
code_block_4 = CodeBlock { false; }
clean = List.Clean(list=byOriginVectors, preserveIndices=code_block_4)
VARCoordinateSystem = Output(clean)
