# Dynamo custom node Coordinate System Adaptive Surface Prepare.dyf (Dynamo 2.1.0.7500)
# category: Synthesize.Automate.Adaptive
# Coordinate System Adaptive Surface Prepare

VARSurfaces = Input(VARSurfaces: var[]..[])
VARPointsLists = Input(VARPointsLists: var[]..[])
doesIntersect = Geometry.DoesIntersect(geometry=VARSurfaces, other=VARPointsLists, lacing=Longest)
anyTrue = Custom[CW.List.AnyTrue](VARseq=doesIntersect)  # Returns true if any item in a list of booleans is true.
filterByBoolMask = List.FilterByBoolMask(list=VARPointsLists, mask=anyTrue)
UVParameterAtPoint = Surface.UVParameterAtPoint(surface=VARSurfaces, point=filterByBoolMask.in)
V = UV.V(uV=UVParameterAtPoint)
byIsoCurveOnSurface = Curve.ByIsoCurveOnSurface(baseSurface=VARSurfaces, parameter=V)
parameterAtPoint = Curve.ParameterAtPoint(curve=byIsoCurveOnSurface, point=filterByBoolMask.in)
pointAtParameter = Curve.PointAtParameter(curve=byIsoCurveOnSurface, param=parameterAtPoint)
VARFlip = Input(VARFlip: var[]..[])
normalAtPoint = Surface.NormalAtPoint(surface=VARSurfaces, point=filterByBoolMask.in, lacing=Longest)
byTangency = Line.ByTangency(curve=byIsoCurveOnSurface, parameter=parameterAtPoint)
direction = Line.Direction(line=byTangency)
byOriginVectors = CoordinateSystem.ByOriginVectors(origin=filterByBoolMask.in, xAxis=normalAtPoint, yAxis=direction)
code_block = CodeBlock { 90; }
rotate = CoordinateSystem.Rotate(coordinateSystem=byOriginVectors, origin=filterByBoolMask.in, axis=direction, degrees=code_block)
origin = CoordinateSystem.Origin(coordinateSystem=rotate)
XAxis = CoordinateSystem.XAxis(coordinateSystem=rotate)
reverse = Vector.Reverse(vector=XAxis)
YAxis = CoordinateSystem.YAxis(coordinateSystem=rotate)
ZAxis = CoordinateSystem.ZAxis(coordinateSystem=rotate)
byOriginVectors_2 = CoordinateSystem.ByOriginVectors(origin=origin, xAxis=reverse, yAxis=YAxis, zAxis=ZAxis)
scopeIf = Custom[CW.ScopeIf+](VARtest=VARFlip, VARtrue=byOriginVectors_2, VARfalse=rotate)  # A (hopefully) more robust implementation of ScopeIf. Tests a single boolean and returns a value accordingly.
ZAxis_2 = CoordinateSystem.ZAxis(coordinateSystem=scopeIf)
VARAdaptivePointsOffset = Input(VARAdaptivePointsOffset: var[]..[])
translate = CoordinateSystem.Translate(coordinateSystem=scopeIf, direction=ZAxis_2, distance=VARAdaptivePointsOffset)
isNull = Object.IsNull(obj=translate)
anyTrue_2 = Custom[CW.List.AnyTrue](VARseq=isNull)
filterByBoolMask_2 = List.FilterByBoolMask(list=translate, mask=anyTrue_2)
VARCoordinateSystem = Output(filterByBoolMask_2.out)
