# Dynamo custom node Coordinate Sytem Rotate By Z Axis.dyf (Dynamo 2.1.0.7500)
# category: Synthesize.Automate.Adaptive
# Coordinate Sytem Rotate By Z Axis

VARcoordinateSystem = Input(VARcoordinateSystem: Autodesk.DesignScript.Geometry.CoordinateSystem)
origin = CoordinateSystem.Origin(coordinateSystem=VARcoordinateSystem)
XAxis = CoordinateSystem.XAxis(coordinateSystem=VARcoordinateSystem)
YAxis = CoordinateSystem.YAxis(coordinateSystem=VARcoordinateSystem)
byOriginXAxisYAxis = Plane.ByOriginXAxisYAxis(origin=origin, xAxis=XAxis, yAxis=YAxis)
VARdegrees = Input(VARdegrees: double)
rotate = CoordinateSystem.Rotate(coordinateSystem=VARcoordinateSystem, plane=byOriginXAxisYAxis, degrees=VARdegrees)
VARCoordinateSystem = Output(rotate)
