# Dynamo custom node Coordination Family Update.dyf (Dynamo 2.1.0.7500)
# category: Synthesize.Automate.Family
# Coordination Family Update

VARXparameterName = Input(VARXparameterName: string)
VARFamilyInstance = Input(VARFamilyInstance: var[]..[])
firstItem = List.FirstItem(list=VARFamilyInstance)
turnIntoList = Custom[CW.TurnIntoList](VARunknownItem=firstItem)  # Turns an element (or a nested list) into a flat list
parameterExists = Custom[CW.Element.ParameterExists](VARparam=VARXparameterName, VARelement=turnIntoList)  # Checks if an element contains a parameter of a given name
empty = List.Empty()
scopeIf = Custom[CW.ScopeIf+](VARtest=parameterExists, VARtrue=VARFamilyInstance, VARfalse=empty)  # A (hopefully) more robust implementation of ScopeIf. Tests a single boolean and returns a value accordingly.
VARInternalOrigin1ProjectBasePoint2Surve = Input(VARInternalOrigin1ProjectBasePoint2SurveyPoint3: var[]..[])
VARPoints = Input(VARPoints: var[]..[])
basePoint = Coordinates.BasePoint()
byOrigin = CoordinateSystem.ByOrigin(origin=basePoint)
byOrigin_2 = CoordinateSystem.ByOrigin()
transform = Geometry.Transform(geometry=VARPoints, fromCoordinateSystem=byOrigin, contextCoordinateSystem=byOrigin_2)
surveyPoint = Coordinates.SurveyPoint()
byOrigin_3 = CoordinateSystem.ByOrigin(origin=surveyPoint)
transform_2 = Geometry.Transform(geometry=VARPoints, fromCoordinateSystem=byOrigin_3, contextCoordinateSystem=byOrigin_2)
python_script = Python(IN[0]=VARInternalOrigin1ProjectBasePoint2Surve, IN[1]=VARPoints, IN[2]=transform, IN[3]=transform_2)
# ---------- python_script.python (24 lines) ----------
import clr
clr.AddReference('ProtoGeometry')
from Autodesk.DesignScript.Geometry import *
#The inputs to this node will be stored as a list in the IN variables.
dataEnteringNode = IN

bool = IN[0]
internal = IN[1]
base = IN[2]
survey = IN[3]

if bool == 1:
	result = internal
	report = "Internal Origin"
elif bool == 2:
	result = base
	report = "Project Base Point"
elif bool ==3:
	result = survey
	report = "Survey Point"


#Assign your output to the OUT variable.
OUT = result, report
# ----------------------------------------
code_block = CodeBlock(a=python_script) { a[0]; a[1]; }
XYZ = Custom[LF.Point.XYZ](VARpoint=code_block.out0)  # Get the X, Y, and Z components of a Point
VARprecision = Input(VARprecision: double)
roundToPrecision = Custom[CW.Math.RoundToPrecision](VARdbl=XYZ.VARX, VARprecision=VARprecision)  # Rounds a number to a specified precision
setParameterByName = Element.SetParameterByName(element=scopeIf, parameterName=VARXparameterName, value=roundToPrecision)
VARYparameterName = Input(VARYparameterName: string)
parameterExists_2 = Custom[CW.Element.ParameterExists](VARparam=VARYparameterName, VARelement=turnIntoList)
scopeIf_2 = Custom[CW.ScopeIf+](VARtest=parameterExists_2, VARtrue=VARFamilyInstance, VARfalse=empty)
roundToPrecision_2 = Custom[CW.Math.RoundToPrecision](VARdbl=XYZ.VARY, VARprecision=VARprecision)
setParameterByName_2 = Element.SetParameterByName(element=scopeIf_2, parameterName=VARYparameterName, value=roundToPrecision_2)
VARZparameterName = Input(VARZparameterName: string)
parameterExists_3 = Custom[CW.Element.ParameterExists](VARparam=VARZparameterName, VARelement=turnIntoList)
scopeIf_3 = Custom[CW.ScopeIf+](VARtest=parameterExists_3, VARtrue=VARFamilyInstance, VARfalse=empty)
roundToPrecision_3 = Custom[CW.Math.RoundToPrecision](VARdbl=XYZ.VARZ, VARprecision=VARprecision)
setParameterByName_3 = Element.SetParameterByName(element=scopeIf_3, parameterName=VARZparameterName, value=roundToPrecision_3)
VARPointReferenceParameter = Input(VARPointReferenceParameter: string)
parameterExists_4 = Custom[CW.Element.ParameterExists](VARparam=VARPointReferenceParameter, VARelement=turnIntoList)
scopeIf_4 = Custom[CW.ScopeIf+](VARtest=parameterExists_4, VARtrue=VARFamilyInstance, VARfalse=empty)
watch = Watch(code_block.out1)
setParameterByName_4 = Element.SetParameterByName(element=scopeIf_4, parameterName=VARPointReferenceParameter, value=watch)
VARTimeparameter = Input(VARTimeparameter: string)
parameterExists_5 = Custom[CW.Element.ParameterExists](VARparam=VARTimeparameter, VARelement=turnIntoList)
python_script_2 = Python(IN[0]=parameterExists, IN[1]=parameterExists_2, IN[2]=parameterExists_3, IN[3]=parameterExists_4, IN[4]=parameterExists_5)
# ---------- python_script_2.python (48 lines) ----------
#This script pops up a dialog box with a message from the previous node.
import clr
clr.AddReference('RevitAPIUI')

from Autodesk.Revit.UI import TaskDialog

xp = IN[0]
yp = IN[1]
zp = IN[2]
ref = IN[3]
date = IN[4]

if xp[0] == False:
	xp = "X Parameter - Number Type\n"
else:
	xp = ""

if yp[0] == False:
	yp = "Y Parameter - Number Type\n"
else:
	yp = ""
	
if zp[0] == False:
	zp = "Z Parameter - Number Type\n"
else:
	zp = ""

if ref[0] == False:
	ref = "Point Reference Parameter - Text Type\n"
else:
	ref = ""

if date[0] == False:
	date = "Date Parameter - Text Type\n"
else:
	date = ""
	

all = "Please Add The Following Parameters To Coordination Family\n\n" + xp + yp + zp + ref + date

if xp == "" and yp == "" and zp == "" and ref == "" and date == "":
	pass
else:
	messagePop = TaskDialog("Synthesize toolkit")
	messagePop.MainContent = all
	messagePop.Show()

OUT = "Success!"
# ----------------------------------------
scopeIf_5 = Custom[CW.ScopeIf+](VARtest=parameterExists_5, VARtrue=VARFamilyInstance, VARfalse=empty)
now = DateTime.Now()
string_from_object = FromObject(obj=now)
setParameterByName_5 = Element.SetParameterByName(element=scopeIf_5, parameterName=VARTimeparameter, value=string_from_object)
VARElements = Output(firstItem)
