# Dynamo custom node Create Pads By Boundary Lines (Smart).dyf (Dynamo 2.1.0.7500)
# category: Synthesize.Automate.Floors
# Create Floors By Boundary Lines (Smart)

code_block = CodeBlock { true; }
VAROffsetRounding = Input(VAROffsetRounding: var[]..[])
code_block_2 = CodeBlock { 1; }
VARUseAllLevelsIgnoresLevelsSelectionFil = Input(VARUseAllLevelsIgnoresLevelsSelectionFilter: var[]..[])
element_types = ElementTypes("Level")
all_elements_of_type = ElementsOfType(element_type=element_types)
hot_get_all_filter = Custom[HOT.Get All Filter]()  # Get all Filter
VARLevelsSelectionFiltertoRead = Input(VARLevelsSelectionFiltertoRead: var[]..[])
eq = hot_get_all_filter.VARName == VARLevelsSelectionFiltertoRead
filterByBoolMask = List.FilterByBoolMask(list=hot_get_all_filter.VARElement, mask=eq)
elements = Custom[CW.SelectionSet.Elements](VARselectionSet=filterByBoolMask.in)  # Retrieves all elements stored in a selection set
flatten = List.Flatten(list=elements)
scopeIf = Custom[CW.ScopeIf+](VARtest=VARUseAllLevelsIgnoresLevelsSelectionFil, VARtrue=all_elements_of_type, VARfalse=flatten)  # A (hopefully) more robust implementation of ScopeIf. Tests a single boolean and returns a value accordingly.
flatten_2 = List.Flatten(list=scopeIf)
VARPadsBoundariesPolycurves = Input(VARPadsBoundariesPolycurves: var[]..[])
code_block_3 = CodeBlock { false; }
clean = List.Clean(list=VARPadsBoundariesPolycurves, preserveIndices=code_block_3)
closeWithLine = PolyCurve.CloseWithLine(polyCurve=clean)
startPoint = Curve.StartPoint(curve=closeWithLine)
VAROffset = Input(VAROffset: var[]..[])
detect_levels_of_points = Custom[Detect Levels of Points](VARSetOffsetParameter=code_block, VARRoundingValue=VAROffsetRounding, VARRoundingFix=code_block, VARFixFactorDependsofProjectUnits1Formetersforexampleand100forCentimeters=code_block_2, VARLevels=flatten_2, VARPoints=startPoint, VARZLocationOffset=VAROffset)  # Family Refine Levels and Offset
flatten_3 = List.Flatten(list=detect_levels_of_points.VARLevelsSet)
VARPadType = Input(VARPadType: var[]..[])
building_pad_type_selector = Custom[Building Pad Type Selector](VARBuildingPadTypeName=VARPadType)  # Building Pad Type Selector
curves = PolyCurve.Curves(polyCurve=closeWithLine)
code_block_4 = CodeBlock { 0; }
curves_offset_to_revit = Custom[Curves Offset To Revit Compatibility](VARCurves=curves, VAROffset=code_block_4)  # Curves Offset To Revit Compatibility
create_pads_by_level_and_curves = Custom[Create Pads By Level and Curves Loops](VARLevels=flatten_3, VARPadType=building_pad_type_selector, VARCurves=curves_offset_to_revit.VARCurves@L2, lacing=Longest)  # Create Pads By Level and Curves Loops
isNull = Object.IsNull(obj=create_pads_by_level_and_curves)
filterByBoolMask_2 = List.FilterByBoolMask(list=create_pads_by_level_and_curves, mask=isNull)
code_block_5 = CodeBlock { "Height Offset From Level"; }
filterByBoolMask_3 = List.FilterByBoolMask(list=detect_levels_of_points.VARElevationsSet, mask=isNull)
setParameterByName = Element.SetParameterByName(element=filterByBoolMask_2.out, parameterName=code_block_5, value=filterByBoolMask_3.out)
count = List.Count(list=setParameterByName)
VARNumberofPadsCreated = Output(count)
VARPads = Output(setParameterByName)
