# Dynamo custom node Create Roofs By Boundary Lines (Smart).dyf (Dynamo 2.1.0.7500)
# category: Synthesize.Automate.Floors
# Create Floors By Boundary Lines (Smart)

VARRoofsBoundariesPolycurves = Input(VARRoofsBoundariesPolycurves: var[]..[])
turnIntoList = Custom[CW.TurnIntoList](VARunknownItem=VARRoofsBoundariesPolycurves)  # Turns an element (or a nested list) into a flat list
code_block = CodeBlock { false; }
clean = List.Clean(list=turnIntoList, preserveIndices=code_block)
closeWithLine = PolyCurve.CloseWithLine(polyCurve=clean)
curves = PolyCurve.Curves(polyCurve=closeWithLine)
VAROffset = Input(VAROffset: var[]..[])
curves_offset_to_revit = Custom[Curves Offset To Revit Compatibility](VARCurves=curves, VAROffset=VAROffset)  # Curves Offset To Revit Compatibility
VARRoofType = Input(VARRoofType: var[]..[])
name = RoofType.Name(roofType=VARRoofType, lacing=Longest)
byName = RoofType.ByName(name=name, lacing=Longest)
VARSetOffsetParameter = Input(VARSetOffsetParameter: var[]..[])
VARRounding = Input(VARRounding: var[]..[])
VARRoundingFix = Input(VARRoundingFix: var[]..[])
VARFixFactorDependsofProjectUnits1Formet = Input(VARFixFactorDependsofProjectUnits1Formetersforexampleand100forCentimeters: var[]..[])
VARUseAllLevelsIgnoresLevelsSelectionFil = Input(VARUseAllLevelsIgnoresLevelsSelectionFilter: var[]..[])
element_types = ElementTypes("Level")
all_elements_of_type = ElementsOfType(element_type=element_types)
hot_get_all_filter = Custom[HOT.Get All Filter]()  # Get all Filter
VARLevelsSelectionFiltertoRead = Input(VARLevelsSelectionFiltertoRead: var[]..[])
eq = hot_get_all_filter.VARName == VARLevelsSelectionFiltertoRead
filterByBoolMask = List.FilterByBoolMask(list=hot_get_all_filter.VARElement, mask=eq)
elements = Custom[CW.SelectionSet.Elements](VARselectionSet=filterByBoolMask.in)  # Retrieves all elements stored in a selection set
flatten = List.Flatten(list=elements)
scopeIf = Custom[CW.ScopeIf+](VARtest=VARUseAllLevelsIgnoresLevelsSelectionFil, VARtrue=all_elements_of_type, VARfalse=flatten)  # A (hopefully) more robust implementation of ScopeIf. Tests a single boolean and returns a value accordingly.
flatten_2 = List.Flatten(list=scopeIf)
startPoint = Curve.StartPoint(curve=closeWithLine)
code_block_2 = CodeBlock { 0; }
detect_levels_of_points = Custom[Detect Levels of Points](VARSetOffsetParameter=VARSetOffsetParameter, VARRoundingValue=VARRounding, VARRoundingFix=VARRoundingFix, VARFixFactorDependsofProjectUnits1Formetersforexampleand100forCentimeters=VARFixFactorDependsofProjectUnits1Formet, VARLevels=flatten_2, VARPoints=startPoint, VARZLocationOffset=code_block_2)  # Family Refine Levels and Offset
flatten_3 = List.Flatten(list=detect_levels_of_points.VARLevelsSet)
byOutlineTypeAndLevel = Roof.ByOutlineTypeAndLevel(outline=curves_offset_to_revit.VARCurves, roofType=byName, level=flatten_3, lacing=Longest)
code_block_3 = CodeBlock { "Base Offset From Level"; }
setParameterByName = Element.SetParameterByName(element=byOutlineTypeAndLevel, parameterName=code_block_3, value=detect_levels_of_points.VARElevationsSet)
count = List.Count(list=byOutlineTypeAndLevel)
VARNumberofRoofsCreated = Output(count)
VARRoofs = Output(byOutlineTypeAndLevel)
