# Dynamo custom node Curves to Nurbs Curve.dyf (Dynamo 2.1.0.7500)
# category: Synthesize.Automate.Lines
# Curves to Nurbs Curve

VARCurves = Input(VARCurves: var[]..[])
flatten = List.Flatten(list=VARCurves)
string_from_object = FromObject(obj=flatten)
code_block = CodeBlock { "NurbsCurve(Degree = 3)"; }
eq = string_from_object == code_block
filterByBoolMask = List.FilterByBoolMask(list=flatten, mask=eq)
controlPoints = NurbsCurve.ControlPoints(nurbsCurve=filterByBoolMask.in)
byControlPoints = NurbsCurve.ByControlPoints(points=controlPoints)
mergeByBoolMask = Custom[SP.List.MergeByBoolMask](VARIn=byControlPoints, VAROut=filterByBoolMask.out, VARmask=eq)  # Merge two lists by a boolean mask list. The true count in the mask should be the same as the length of the true list and vice versa for the false list.
VARNurbsCurve = Output(mergeByBoolMask)
