# Dynamo custom node Curves to Quad Surface.dyf (Dynamo 2.1.0.7500)
# category: Synthesize.Automate.Surface
# Understand Quad Faces

VARSurfaces = Input(VARSurfaces: var[]..[])
python_script = Python(IN[0]=VARSurfaces)
# ---------- python_script.python (98 lines) ----------
# Enable Python support and load DesignScript library
# IMPORTANT : ALL DYNAMO DESIGN SCRIPT NODES ARE AS (dg)
import clr
clr.AddReference('ProtoGeometry')
from Autodesk.DesignScript import Geometry as dg

# EXTENSION Enable ToDSType
clr.AddReference('RevitNodes')
import Revit
clr.ImportExtensions(Revit.Elements)

# Enable Revit Elements
from Revit.Elements import *

# EXTENSION Enable Geometry Conversion Methods
clr.ImportExtensions(Revit.GeometryConversion)

# Enable Revit API
clr.AddReference('RevitAPI')
from Autodesk.Revit.DB import *

# Enable DocumentManager and TransactionManager
clr.AddReference('RevitServices')
from RevitServices.Persistence import DocumentManager
from RevitServices.Transactions import TransactionManager

# Enable ICollection List Translate
clr.AddReference("System")
import System.Collections.Generic
from System.Collections.Generic import List

dataEnteringNode = IN
# Use UnwrapElement(IN[0]) When Translating From Dynamo to Revit
curves=UnwrapElement(IN[0])

# Choose The Current Document
doc = DocumentManager.Instance.CurrentDBDocument
uidoc = DocumentManager.Instance.CurrentUIApplication.ActiveUIDocument
uiapp = DocumentManager.Instance.CurrentUIApplication
app = uiapp.Application

# Create Empty List
result = []
for clist in curves:
	if len(clist) == 4:
		try:
			try:
				result.append(dg.Surface.ByLoft([clist[0],clist[2]],[clist[1],clist[3]]))
			except:
				try:
					result.append(dg.Surface.ByLoft([clist[1],clist[3]],[clist[0],clist[2]]))
				except:
					try:
						areas = []
						surfat = []
						try:
							surf = dg.Surface.ByLoft([clist[1],clist[3]])
							areas.append(surf.Area)
							surfat.append(surf)
						except:
							pass
						try:
							surf2 = dg.Surface.ByLoft([clist[0],clist[2]])
							areas.append(surf2.Area)
							surfat.append(surf2)
						except:
							pass
						maxarea = max(areas)
						maxind = areas.index(maxarea)
						wantedsurf = surfat[maxind]
						bboxorg = dg.BoundingBox.ByGeometry(clist)
						bboxnew = dg.BoundingBox.ByGeometry(wantedsurf)
						minorg = bboxorg.MinPoint
						maxorg = bboxorg.MaxPoint
						midorg = dg.Curve.PointAtParameter(dg.Line.ByStartPointEndPoint(minorg,maxorg),0.5)
						minnew = bboxnew.MinPoint
						maxnew = bboxnew.MaxPoint
						midnew = dg.Curve.PointAtParameter(dg.Line.ByStartPointEndPoint(minnew,maxnew),0.5)
						orgX = round(midorg.X,2)
						orgY = round(midorg.Y,2)
						orgZ = round(midorg.Z,2)
						newX = round(midnew.X,2)
						newY = round(midnew.Y,2)
						newZ = round(midnew.Z,2)
						dis = dg.Geometry.DistanceTo(midorg,midnew)
						if round(dis,1) == 0:
							result.append(wantedsurf)
						else:
							result.append(None)
					except:
						result.append(None)
					
		except:
			result.append(None)
	else:
		result.append(None)
# Assign your output to the OUT variable.
OUT = result
# ----------------------------------------
VARNurbsSurfaces = Output(python_script)
