# Dynamo custom node DA.Dynanimate Numeric Parameter And Camera Position With Fixed Target.dyf (Dynamo 2.1.0.7500)
# category: Synthesize.Packages.Dynanimator.Cameras
# Animates the camera of a perspective view around a fixed target.

VARIterations = Input(VARIterations: var[]..[])
code_block = CodeBlock(n=VARIterations) { 0..(n-1); }
VARDirectoryPath = Input(VARDirectoryPath: var[]..[])
VARView = Input(VARView: var[]..[])
VARElements = Input(VARElements: var[]..[])
VARParameterName = Input(VARParameterName: var[]..[])
VARMinParamValue = Input(VARMinParamValue: var[]..[])
VARMaxParamValue = Input(VARMaxParamValue: var[]..[])
VARCameraPath = Input(VARCameraPath: var[]..[])
geometry = Element.Geometry(element=VARCameraPath)
VARTargetPosition = Input(VARTargetPosition: var[]..[])
da_dynanimatorfunction_numeric = Custom[DA.DynanimatorFunction Numeric Parameter And Camera Position With Fixed Target](VARTotalIterations=VARIterations, VARDirectoryPath=VARDirectoryPath, VARView=VARView, VARElements=VARElements, VARParameterName=VARParameterName, VARMinParamValue=VARMinParamValue, VARMaxParamValue=VARMaxParamValue, VARCameraPath=geometry, VARTargetPosition=VARTargetPosition)  # Helper function for Dynanimate Camera Position With Fixed Target; unwired: VARIteration
map = List.Map(list=code_block, f_x=da_dynanimatorfunction_numeric)
VAR = Output(map)
