# Dynamo custom node DA.Dynanimate Numeric Parameter.dyf (Dynamo 2.1.0.7500)
# category: Synthesize.Packages.Dynanimator.ElementProperties
# Animates parameter values of a selection of elements.

VARIterations = Input(VARIterations: var[]..[])
code_block = CodeBlock(n=VARIterations) { 0..(n-1); }
VARDirectoryPath = Input(VARDirectoryPath: var[]..[])
VARView = Input(VARView: var[]..[])
VARElements = Input(VARElements: var[]..[])
VARParameterName = Input(VARParameterName: var[]..[])
VARMinParamValue = Input(VARMinParamValue: var[]..[])
VARMaxParamValue = Input(VARMaxParamValue: var[]..[])
da_dynanimatorfunction_numeric = Custom[DA.DynanimatorFunction Numeric Parameter](VARTotalIterations=VARIterations, VARDirectoryPath=VARDirectoryPath, VARView=VARView, VARElements=VARElements, VARParameterName=VARParameterName, VARMinParamValue=VARMinParamValue, VARMaxParamValue=VARMaxParamValue)  # Helper function for Dynanimate Numeric Parameter; unwired: VARIteration
map = List.Map(list=code_block, f_x=da_dynanimatorfunction_numeric)
VAR = Output(map)
