# Dynamo custom node DA.DynanimatorFunction Numeric Parameter And Camera Position With Fixed Target.dyf (Dynamo 2.1.0.7500)
# category: Synthesize.Packages.Dynanimator.Functions
# Helper function for Dynanimate Camera Position With Fixed Target

VARIteration = Input(VARIteration: var[]..[])
VARTotalIterations = Input(VARTotalIterations: var[]..[])
VARView = Input(VARView: var[]..[])
VARElements = Input(VARElements: var[]..[])
VARParameterName = Input(VARParameterName: var[]..[])
VARMinParamValue = Input(VARMinParamValue: var[]..[])
VARMaxParamValue = Input(VARMaxParamValue: var[]..[])
VARCameraPath = Input(VARCameraPath: var[]..[])
VARTargetPosition = Input(VARTargetPosition: var[]..[])
da_dynanimatornestedfunction = Custom[DA.DynanimatorNestedFunction Numeric Parameter And Camera Position With Fixed Target](VARIteration=VARIteration, VARTotalIterations=VARTotalIterations, VARView=VARView, VARElements=VARElements, VARParameterName=VARParameterName, VARMinValue=VARMinParamValue, VARMaxValue=VARMaxParamValue, VARCameraPath=VARCameraPath, VARTargetPosition=VARTargetPosition)  # Nested function used in DynanimatorFunction Numeric Parameter And Camera Position With Fixed Target
end = Revit.Transaction.Transaction.End(input=da_dynanimatornestedfunction)
VARDirectoryPath = Input(VARDirectoryPath: var[]..[])
string = StringInput("\")  # graph input
name = Element.Name(element=VARView)
string_2 = StringInput("_")  # graph input
string_from_object = FromObject(obj=VARIteration)
string_3 = StringInput(".png")  # graph input
concat = String.Concat(string0=VARDirectoryPath, string1=string, string2=name, string3=string_2, string4=string_from_object, string5=string_3)
exportAsImage = View.ExportAsImage(view=VARView, path=concat)
end_2 = Revit.Transaction.Transaction.End(input=exportAsImage)
compose = ComposeFunctions(func0=end, func1=end_2)  # "Function.Compose"
