# Dynamo custom node DA.ElementsOfCategory(InclLinks).dyf (Dynamo 2.1.0.7500)
# category: Synthesize.Packages.ReAnimation.Revit.Miscellaneous
# Collects all elements of a Category including elements in all links

VARCategory = Input(VARCategory: var[]..[])
python_script = Python(IN[0]=VARCategory)
# ---------- python_script.python (30 lines) ----------
import clr
clr.AddReference('ProtoGeometry')
clr.AddReference('RevitAPI')
clr.AddReference('RevitServices')
clr.AddReference("RevitNodes")
import Revit
clr.ImportExtensions(Revit.Elements)
clr.ImportExtensions(Revit.GeometryConversion)
from Autodesk.DesignScript.Geometry import *
from Autodesk.Revit.DB import *
from RevitServices.Persistence import DocumentManager

# Variables
doc = DocumentManager.Instance.CurrentDBDocument
linkInstances = FilteredElementCollector(doc).OfClass(RevitLinkInstance).ToElements()
cats = UnwrapElement(IN[0])
allDocs, allElements = [], []
temp = []

# Code
allDocs.append(doc)
for i in linkInstances:
	allDocs.append(i.GetLinkDocument())

for a in allDocs:
	elems = FilteredElementCollector(a).OfCategoryId(cats.Id).WhereElementIsNotElementType().ToElements()
	allElements.append(elems)

# Output
OUT = [item for sublist in allElements for item in sublist]
# ----------------------------------------
VARElements = Output(python_script)
