# Dynamo custom node DS.All Elements In View(s).dyf (Dynamo 2.1.0.7500)
# category: Synthesize.Packages.Data-Shapes.Revit.Elements
# Retrieves all visible element in a view or a set of views

VARViews = Input(VARViews: var[]..[])
python_script = Python(IN[0]=VARViews)
# ---------- python_script.python (17 lines) ----------
#Copyright (c) mostafa el ayoubi ,  2017
#Data-Shapes www.data-shapes.net , elayoubi.mostafa@gmail.com

import clr
clr.AddReference('RevitAPI')
from Autodesk.Revit.DB import*
clr.AddReference('RevitServices')
from RevitServices.Persistence import DocumentManager

doc = DocumentManager.Instance.CurrentDBDocument

if isinstance(IN[0],list):
	views = UnwrapElement(IN[0])
else:
	views = [UnwrapElement(IN[0])]

OUT = [FilteredElementCollector(doc,v.Id).ToElements() for v in views]
# ----------------------------------------
VARElements = Output(python_script)
