# Dynamo custom node DS.Export to FBX.dyf (Dynamo 2.1.0.7500)
# category: Synthesize.Packages.Data-Shapes.Export
# Exports 3D views to FBX format

VARExportFolderPath = Input(VARExportFolderPath: var[]..[])
VARprefix = Input(VARprefix: var[]..[])
VAR3DViews = Input(VAR3DViews: var[]..[])
python_script = Python(IN[0]=VARExportFolderPath, IN[1]=VARprefix, IN[2]=VAR3DViews)
# ---------- python_script.python (47 lines) ----------
#Copyright (c) mostafa el ayoubi, 2016 elayoub.mostafa@gmail.com
#Data-Shapes www.data-shapes.net
#Made Smarter By Karam Baki : karam@aecedx.com
#AECexx www.aecedx.com

import sys
sys.path.append(r'C:\Program Files (x86)\IronPython 2.7\DLLs')
sys.path.append(r'C:\Program Files (x86)\IronPython 2.7\Lib')

import clr
clr.AddReference('RevitAPI')
from Autodesk.Revit.DB import*
clr.AddReference('RevitServices')
from RevitServices.Persistence import DocumentManager
from RevitServices.Transactions import TransactionManager

import os

doc = DocumentManager.Instance.CurrentDBDocument

t = Transaction(doc,'export')
t.Start()

def tolist(input):
	if isinstance(input,list):
		return input
	else:
		return [input]

folder = IN[0]
prefix = IN[1]
views = tolist(IN[2])
result = []
vset = ViewSet()


for v in views:
	vset.Insert(UnwrapElement(v))
	i = 1
	while os.path.exists(folder+"\\"+prefix+UnwrapElement(v).Name+" Save "+"%s.fbx" % i):
		i += 1
	nametosave = prefix+UnwrapElement(v).Name + " Save " + str(i)
	result.append(doc.Export(folder,nametosave,vset,FBXExportOptions()))

t.Commit()

OUT = "Success"
# ----------------------------------------
VAROUT = Output(python_script)
