# Dynamo custom node DelaFix.dyf (Dynamo 2.1.0.7500)
# category: Synthesize.Delaunay
# Delaunay Pattern Fix by Karam Baki

VARSelectFaces = Input(VARSelectFaces: var[]..[])
byJoinedSurfaces = PolySurface.ByJoinedSurfaces(surfaces=VARSelectFaces)
surfaces = PolySurface.Surfaces(polySurface=byJoinedSurfaces)
VARFixFactorDependsonProjectUnitsEX2Mete = Input(VARFixFactorDependsonProjectUnitsEX2Meters: var[]..[])
thicken = Surface.Thicken(surface=surfaces, thickness=VARFixFactorDependsonProjectUnitsEX2Mete)
VARUDensityEX200 = Input(VARUDensityEX200: var[]..[])
randomList = Math.RandomList(amount=VARUDensityEX200)
VARUMinRange = Input(VARUMinRange: int = 0)
VARUMaxRange = Input(VARUMaxRange: int = 1)
remapRange = Math.RemapRange(numbers=randomList, newMin=VARUMinRange, newMax=VARUMaxRange)
VARVDensityEX200 = Input(VARVDensityEX200: var[]..[])
randomList_2 = Math.RandomList(amount=VARVDensityEX200)
VARVMinRange = Input(VARVMinRange: int = 0)
VARVMaxRange = Input(VARVMaxRange: int = 1)
remapRange_2 = Math.RemapRange(numbers=randomList_2, newMin=VARVMinRange, newMax=VARVMaxRange)
byCoordinates = UV.ByCoordinates(u=remapRange, v=remapRange_2)
byParametersOnSurface = Tessellation.Delaunay.ByParametersOnSurface(uvs=byCoordinates, face=surfaces)
intersect = Geometry.Intersect(geometry=thicken, other=byParametersOnSurface)
flatten = List.Flatten(list=intersect)
startPoint = Curve.StartPoint(curve=flatten)
endPoint = Curve.EndPoint(curve=flatten)
create = List.Create(item0=startPoint, item1=endPoint)
transpose = List.Transpose(lists=create)
VARPairPoints = Output(transpose)
boolean = BoolSelector(false)  # graph input
clean = List.Clean(list=intersect, preserveIndices=boolean)
pullOntoSurface = Curve.PullOntoSurface(curve=clean, surface=byJoinedSurfaces)
VARCurves = Output(pullOntoSurface)
VARUV = Output(byCoordinates)
