# Dynamo custom node Delete Duplicated Elements From List.dyf (Dynamo 2.1.0.7500)
# category: Synthesize.Automate.Family
# Delete Duplicated Elements From List

VARElementsList = Input(VARElementsList: var[]..[])
python_script = Python(IN[0]=VARElementsList)
# ---------- python_script.python (94 lines) ----------
# Enable Python support and load DesignScript library
# IMPORTANT : ALL DYNAMO DESIGN SCRIPT NODES ARE AS (dg)
import clr
clr.AddReference('ProtoGeometry')
from Autodesk.DesignScript import Geometry as dg

# EXTENSION Enable ToDSType
clr.AddReference('RevitNodes')
import Revit
clr.ImportExtensions(Revit.Elements)

# Enable Revit Elements
from Revit.Elements import *

# EXTENSION Enable Geometry Conversion Methods
clr.ImportExtensions(Revit.GeometryConversion)

# Enable Revit API
clr.AddReference('RevitAPI')
from Autodesk.Revit.DB import *

# Enable DocumentManager and TransactionManager
clr.AddReference('RevitServices')
from RevitServices.Persistence import DocumentManager
from RevitServices.Transactions import TransactionManager

# Enable ICollection List Translate
clr.AddReference("System")
import System.Collections.Generic
from System.Collections.Generic import List

def tolist(obj1):
	if hasattr(obj1,'__iter__'): return obj1
	else: return [obj1]

def flatten(x):
    result = []
    for el in x:
        if hasattr(el, "__iter__") and not isinstance(el, basestring):
            result.extend(flatten(el))
        else:
            result.append(el)
    return result

dataEnteringNode = IN
# Use UnwrapElement(IN[0]) When Translating From Dynamo to Revit
elements=UnwrapElement(flatten(tolist(IN[0])))

ids = []
for e in elements:
	try:
		ids.append(e.Id)
	except:
		pass

# Choose The Current Document
doc = DocumentManager.Instance.CurrentDBDocument
uidoc = DocumentManager.Instance.CurrentUIApplication.ActiveUIDocument
uiapp = DocumentManager.Instance.CurrentUIApplication
app = uiapp.Application

# Create Empty List
tofix = []

wlist = doc.GetWarnings()
for warn in wlist:
	wtext = warn.GetDescriptionText()
	if wtext == "There are identical instances in the same place. This will result in double counting in schedules.":
		welt = warn.GetFailingElements()
		good = True
		for el in welt:
			if el in ids:
				pass
			else:
				good = False
				break
		if good:
			tofix.append(welt)
# Start a Transaction with Current Document (doc)
TransactionManager.Instance.EnsureInTransaction(doc)

result = []
for tf in tofix:
	try:
		doc.Delete(tf[1])
		result.append(tf[0])
	except:
		pass
# End the Transaction with Current Document ()
TransactionManager.Instance.TransactionTaskDone()


# Assign your output to the OUT variable.
OUT = result
# ----------------------------------------
VARLeftElements = Output(python_script)
