# Dynamo custom node Dimensions Leader Position.dyf (Dynamo 2.1.0.7500)
# category: Synthesize.Automate.Dimensions
# Dimensions Leader Position

VARDimensions = Input(VARDimensions: var[]..[])
python_script = Python(IN[0]=VARDimensions)
# ---------- python_script.python (72 lines) ----------
# Enable Python support and load DesignScript library
# IMPORTANT : ALL DYNAMO DESIGN SCRIPT NODES ARE AS (dg)
import clr
clr.AddReference('ProtoGeometry')
from Autodesk.DesignScript import Geometry as dg

# EXTENSION Enable ToDSType
clr.AddReference('RevitNodes')
import Revit
clr.ImportExtensions(Revit.Elements)

# Enable Revit Elements
from Revit.Elements import *

# EXTENSION Enable Geometry Conversion Methods
clr.ImportExtensions(Revit.GeometryConversion)

# Enable Revit API
clr.AddReference('RevitAPI')
from Autodesk.Revit.DB import *

# Enable DocumentManager and TransactionManager
clr.AddReference('RevitServices')
from RevitServices.Persistence import DocumentManager
from RevitServices.Transactions import TransactionManager

# Enable ICollection List Translate
clr.AddReference("System")
import System.Collections.Generic
from System.Collections.Generic import List

def tolist(obj1):
	if hasattr(obj1,'__iter__'): return obj1
	else: return [obj1]
	
dataEnteringNode = IN
# Use UnwrapElement(IN[0]) When Translating From Dynamo to Revit
dim = tolist(UnwrapElement(IN[0]))

# Choose The Current Document
doc = DocumentManager.Instance.CurrentDBDocument
uidoc = DocumentManager.Instance.CurrentUIApplication.ActiveUIDocument
uiapp = DocumentManager.Instance.CurrentUIApplication
app = uiapp.Application

def GetDimensionLeaderPosition(dim):
	try:
		current = dim.TextPosition
		dim.ResetTextPosition()
		p = [dim.LeaderEndPosition.ToPoint()]
		dim.TextPosition = current
	except:
		p = []
		segs = []
		for seg in dim.Segments:
			current = seg.TextPosition
			seg.ResetTextPosition()
			p.append(seg.LeaderEndPosition.ToPoint())
			seg.TextPosition = current
	return p
	
# Create Empty List
result = []
# Start a Transaction with Current Document (doc)
TransactionManager.Instance.EnsureInTransaction(doc)

for e in dim:
	result.append(GetDimensionLeaderPosition(e))

# End the Transaction with Current Document ()
TransactionManager.Instance.TransactionTaskDone()
OUT = result
# ----------------------------------------
VARPoints = Output(python_script)
