# Dynamo custom node DividedPaths to Surfaces.dyf (Dynamo 2.1.0.7500)
# category: Synthesize.Automate.Reference Plane
# Reference Planes to Surfaces

VARKeepOriginalListItems = Input(VARKeepOriginalListItems: bool = false)
VARLevels = Input(VARLevels: var[]..[])
code_block = CodeBlock { "DividedPath"; }
byClassName = Custom[SP.Filter.ByClassName](VARobject=VARLevels, VARclassName=code_block)  # Filters a list of objects by the object's class name. Note that Dynamo elements belong to different classes than their Revit counterparts. Use the Object.Class node to check an object's class.
planes_and_curve_of_divided_path = Custom[Planes and Curve of Divided Path](VARDividedPaths=byClassName.VARin)  # Planes and Curve of Divided Path
python_all_elements_in_all = Custom[Python All Elements In All Document]()  # Python All Elements In All Document
batch_elements_bounding_box = Custom[Batch Elements Bounding Box](VARElements=python_all_elements_in_all)  # Batch Elements Bounding Box
minPoint = BoundingBox.MinPoint(boundingBox=batch_elements_bounding_box)
maxPoint = BoundingBox.MaxPoint(boundingBox=batch_elements_bounding_box)
byStartPointEndPoint = Line.ByStartPointEndPoint(startPoint=minPoint, endPoint=maxPoint)
length = Curve.Length(curve=byStartPointEndPoint)
byWidthLength = Rectangle.ByWidthLength(plane=planes_and_curve_of_divided_path.VARPlanes, width=length, length=length)
byPatch = Surface.ByPatch(closedCurve=byWidthLength)
mergeByBoolMask = Custom[SP.List.MergeByBoolMask](VARIn=byPatch, VAROut=byClassName.VARout, VARmask=byClassName.VARbool)  # Merge two lists by a boolean mask list. The true count in the mask should be the same as the length of the true list and vice versa for the false list.
scopeIf = Custom[CW.ScopeIf+](VARtest=VARKeepOriginalListItems, VARtrue=mergeByBoolMask, VARfalse=byPatch)  # A (hopefully) more robust implementation of ScopeIf. Tests a single boolean and returns a value accordingly.
VARSurfaces = Output(scopeIf)
