# Dynamo custom node DynaForm Generate Points From Surface.dyf (Dynamo 2.1.0.7500)
# category: Synthesize.Automate.Surface
# Generate UV Grid From Surface

VARDivideByU = Input(VARDivideByU: var[]..[] = FalseDivideByV = True;)
code_block = CodeBlock { null; false; }
VARNurbsSurfaces = Input(VARNurbsSurfaces: var[]..[])
VARUGrid = Input(VARUGrid: var[]..[])
VARVGrid = Input(VARVGrid: var[]..[])
VARParametricU = Input(VARParametricU: var[]..[])
VARParametricV = Input(VARParametricV: var[]..[])
VARSmoothMode = Input(VARSmoothMode: var[]..[])
byNurbsSurfaceUniform = TSpline.TSplineSurface.ByNurbsSurfaceUniform(nurbsSurface=VARNurbsSurfaces, uSpans=VARUGrid, vSpans=VARVGrid, uUseArcLen=VARParametricU, vUseArcLen=VARParametricV, inSmoothMode=VARSmoothMode)
vertices = Topology.Vertices(topology=byNurbsSurfaceUniform)
pointGeometry = Vertex.PointGeometry(vertex=vertices)
flatten = List.Flatten(list=pointGeometry)
pruneDuplicates = Point.PruneDuplicates(points=flatten)
code_block_2 = CodeBlock { 1; }
add = VARUGrid + code_block_2
chop = List.Chop(list=pruneDuplicates, lengths=add)
scopeIf = Custom[CW.ScopeIf+](VARtest=VARDivideByU, VARtrue=code_block.out0, VARfalse=chop)  # A (hopefully) more robust implementation of ScopeIf. Tests a single boolean and returns a value accordingly.
transpose = List.Transpose(lists=chop)
scopeIf_2 = Custom[CW.ScopeIf+](VARtest=VARDivideByU, VARtrue=transpose, VARfalse=code_block.out0)
create = List.Create(item0=scopeIf, item1=scopeIf_2)
clean = List.Clean(list=create, preserveIndices=code_block.out1)
flatten_2 = List.Flatten(list=clean@L2)
VARPoints = Output(flatten_2)
VARImporttoRevit = Input(VARImporttoRevit: var[]..[])
VARSurfaceorSolid = Input(VARSurfaceorSolid: var[]..[])
flatten_3 = List.Flatten(list=VARSurfaceorSolid)
code_block_3 = CodeBlock { null; }
scopeIf_3 = Custom[CW.ScopeIf+](VARtest=VARImporttoRevit, VARtrue=flatten_3, VARfalse=code_block_3)
VARMassFamilyName = Input(VARMassFamilyName: var[]..[])
VARStartSequenceNamingSuffix = Input(VARStartSequenceNamingSuffix: var[]..[])
VARCategory = Input(VARCategory: var[]..[])
VARMethodFalse = Input(VARMethodFalse: var[]..[] = ImportedObjectTrue = MassFamily;)
VARConceptualMassTemplate = Input(VARConceptualMassTemplate: var[]..[])
code_block_4 = CodeBlock { false; }
code_block_5 = CodeBlock { true; }
surfaces_to_family_or_imported = Custom[Surfaces to Family or Imported](VARSurfaceorSolid=scopeIf_3, VARFamilyName=VARMassFamilyName, VARFamilyNumber=VARStartSequenceNamingSuffix, VARFamilyCategory=VARCategory, VARMethodFalseIsImportedObjectTrueIsFamily=VARMethodFalse, VARFamilyTemplate=VARConceptualMassTemplate, VARIsVoid=code_block_4, VAROneFamily=code_block_5, VARAutoSequenceNamingSuffix=code_block_5)  # Surfaces to Family or Imported
VARImportInstance = Output(surfaces_to_family_or_imported.VARImported)
VARNurbsSurfaces_2 = Output(VARNurbsSurfaces)  # "VARNurbsSurfaces"
innerEdges = TSpline.TSplineTopology.InnerEdges(tSplineTopology=byNurbsSurfaceUniform)
curveGeometry = Edge.CurveGeometry(edge=innerEdges)
VARCurves = Output(curveGeometry)
VARFamilyMethodReport = Output(surfaces_to_family_or_imported.VARReport)
VARInElement = Output(surfaces_to_family_or_imported.VARInElement)
VARInFamily = Output(surfaces_to_family_or_imported.VARInFamily)
VARTSplineSurface = Output(byNurbsSurfaceUniform)
