# Dynamo custom node DynaForm Solid Form with Importing.dyf (Dynamo 2.1.0.7500)
# category: Synthesize.Automate.Solid
# Closed Form with Dynamo and importing into Revit directly

VARImporttoRevit = Input(VARImporttoRevit: var[]..[])
VARDirectConnect = Input(VARDirectConnect: var[]..[])
VARPoints = Input(VARPoints: var[]..[])
dynaform_solid_form = Custom[DynaForm Solid Form](VARlist=VARPoints)  # Closed Forms DynaForm
code_block = CodeBlock { true; }
byPoints = NurbsCurve.ByPoints(points=dynaform_solid_form, closeCurve=code_block)
VARdegree = Input(VARdegree: int)
byControlPoints = NurbsCurve.ByControlPoints(points=dynaform_solid_form, degree=VARdegree, closeCurve=code_block)
scopeIf = Custom[CW.ScopeIf+](VARtest=VARDirectConnect, VARtrue=byPoints, VARfalse=byControlPoints)  # A (hopefully) more robust implementation of ScopeIf. Tests a single boolean and returns a value accordingly.
as_polycurve_bycurves = Custom[AS.[&] PolyCurve.ByCurves](VARcurves=scopeIf)  # Create polycurves from an unordered list of curves.
byLoft = Solid.ByLoft(crossSections=as_polycurve_bycurves.VARpolyCurve)
code_block_2 = CodeBlock { null; }
scopeIf_2 = Custom[CW.ScopeIf+](VARtest=VARImporttoRevit, VARtrue=byLoft, VARfalse=code_block_2)
code_block_3 = CodeBlock { true; }
dynamo_geometry_to_revit = Custom[Dynamo Geometry To Revit Compatibility](VARGeometryOrSat=scopeIf_2, VARPreferImportInstance=code_block_3, VARReturnFailures=code_block_3)  # Dynamo Geometry To Revit Compatibility
VARImportInstance = Output(dynamo_geometry_to_revit)
VARGeometry = Output(byLoft)
