# Dynamo custom node DynaLine From UV Grid.dyf (Dynamo 2.1.0.7500)
# category: Synthesize.Automate.Lines
# Create Dynamo Lines From UV Grid

VARSplineThroughPoints = Input(VARSplineThroughPoints: var[]..[])
VARPairs = Input(VARPairs: var[]..[])
VARPoints = Input(VARPoints: var[]..[])
code_block = CodeBlock { "Revit.Elements.ReferencePoint"; }
byClassName = Custom[SP.Filter.ByClassName](VARobject=VARPoints, VARclassName=code_block)  # Filters a list of objects by the object's class name. Note that Dynamo elements belong to different classes than their Revit counterparts. Use the Object.Class node to check an object's class.
subpairs = Custom[SP.List.Subpairs](VARlist=byClassName.VARin@L2)  # Pair up each list item with the next one and drop the list item.
code_block_2 = CodeBlock { null; false; }
scopeIf = Custom[CW.ScopeIf+](VARtest=VARPairs, VARtrue=subpairs, VARfalse=code_block_2.out0)  # A (hopefully) more robust implementation of ScopeIf. Tests a single boolean and returns a value accordingly.
scopeIf_2 = Custom[CW.ScopeIf+](VARtest=VARPairs, VARtrue=code_block_2.out0, VARfalse=byClassName.VARin)
join = List.Join(list0=scopeIf, list1=scopeIf_2)
clean = List.Clean(list=join, preserveIndices=code_block_2.out1)
code_block_3 = CodeBlock { null; }
scopeIf_3 = Custom[CW.ScopeIf+](VARtest=VARSplineThroughPoints, VARtrue=clean, VARfalse=code_block_3)
code_block_4 = CodeBlock { false; }
clean_2 = List.Clean(list=scopeIf_3, preserveIndices=code_block_4)
VARIsReference = Input(VARIsReference: var[]..[])
code_block_5 = CodeBlock { null; }
scopeIf_4 = Custom[CW.ScopeIf+](VARtest=VARSplineThroughPoints, VARtrue=VARIsReference, VARfalse=code_block_5)
create = List.Create(item0=scopeIf_4)
code_block_6 = CodeBlock { false; }
clean_3 = List.Clean(list=create, preserveIndices=code_block_6)
flatten = List.Flatten(list=clean_3)
byReferencePoints = CurveByPoints.ByReferencePoints(points=clean_2@L2, isReferenceLine=flatten)
code_block_7 = CodeBlock { null; }
point = ReferencePoint.Point(referencePoint=clean)
count = List.Count(list=point)
code_block_8 = CodeBlock { 3; }
le = count <= code_block_8
code_block_9 = CodeBlock { 2; }
scopeIf_5 = Custom[CW.ScopeIf+](VARtest=le, VARtrue=code_block_9, VARfalse=code_block_8)
byControlPoints = NurbsCurve.ByControlPoints(points=point, degree=scopeIf_5)
code_block_10 = CodeBlock { 1; 0; }
VARDivisions = Input(VARDivisions: double)
sequence = Sequence(start=code_block_10.out0, amount=VARDivisions, step=code_block_10.out0, lacing=Longest)
remapRange = Math.RemapRange(numbers=sequence, newMin=code_block_10.out1, newMax=code_block_10.out0)
pointAtParameter = Curve.PointAtParameter(curve=byControlPoints@L1, param=remapRange)
create_2 = List.Create(item0=pointAtParameter)
scopeIf_6 = Custom[CW.ScopeIf+](VARtest=VARSplineThroughPoints, VARtrue=code_block_7, VARfalse=create_2)
code_block_11 = CodeBlock { false; }
clean_4 = List.Clean(list=scopeIf_6, preserveIndices=code_block_11)
byPoint = ReferencePoint.ByPoint(pt=clean_4)
scopeIf_7 = Custom[CW.ScopeIf+](VARtest=VARSplineThroughPoints, VARtrue=code_block_3, VARfalse=byPoint)
code_block_12 = CodeBlock { false; }
clean_5 = List.Clean(list=scopeIf_7, preserveIndices=code_block_12)
scopeIf_8 = Custom[CW.ScopeIf+](VARtest=VARSplineThroughPoints, VARtrue=code_block_5, VARfalse=VARIsReference)
create_3 = List.Create(item0=scopeIf_8)
code_block_13 = CodeBlock { false; }
clean_6 = List.Clean(list=create_3, preserveIndices=code_block_13)
flatten_2 = List.Flatten(list=clean_6)
byReferencePoints_2 = CurveByPoints.ByReferencePoints(points=clean_5@L2, isReferenceLine=flatten_2)
create_4 = List.Create(item0=byReferencePoints, item1=byReferencePoints_2)
flatten_3 = List.Flatten(list=create_4)
code_block_14 = CodeBlock { false; }
clean_7 = List.Clean(list=flatten_3, preserveIndices=code_block_14)
VARCurveByPoints = Output(clean_7)
create_5 = List.Create(item0=clean_2, item1=clean_5)
flatten_4 = List.Flatten(list=create_5)
code_block_15 = CodeBlock { false; }
clean_8 = List.Clean(list=flatten_4, preserveIndices=code_block_15)
VARPoints_2 = Output(clean_8)  # "VARPoints"
create_6 = List.Create(item0=clean_2, item1=clean_5)
