# Dynamo custom node Element.Geometry DWG Fixer.dyf (Dynamo 2.1.0.7500)
# category: Synthesize.Automate.Geometry
# Element.Geometry DWG Fixer

VARElements = Input(VARElements: var[]..[])
python_script = Python(IN[0]=VARElements)
# ---------- python_script.python (153 lines) ----------
# Created By Karam Baki, karam@aecedx.com
# Inspired By @5devene, dimitar.ven@gmail.com
import clr
import System
from System.Collections.Generic import *

from itertools import repeat

pf_path = System.Environment.GetFolderPath(System.Environment.SpecialFolder.ProgramFilesX86)
import sys
sys.path.append('%s\IronPython 2.7\Lib' %pf_path)
import traceback
import random
import string

clr.AddReference('ProtoGeometry')
from Autodesk.DesignScript.Geometry import *
from Autodesk.DesignScript.Geometry import Point as DynPoint
from Autodesk.DesignScript.Geometry import Line as DynLine
from Autodesk.DesignScript.Geometry import Curve as DynCurve

clr.AddReference('RevitServices')
import RevitServices
from RevitServices.Persistence import DocumentManager
from RevitServices.Transactions import TransactionManager
doc = DocumentManager.Instance.CurrentDBDocument

clr.AddReference('RevitAPI')
from Autodesk.Revit.DB import *
from Autodesk.Revit.DB.Structure import StructuralType

clr.AddReference('RevitNodes')
import Revit
clr.ImportExtensions(Revit.Elements)
clr.ImportExtensions(Revit.GeometryConversion)

def tolist(obj1):
	if hasattr(obj1,'__iter__'): return obj1
	else: return [obj1]

def analgeom(elem):
	result = []
	try:
		geoms = elem.get_Geometry(opt1)
		for e in geoms:
			if e.ToString() == "Autodesk.Revit.DB.GeometryInstance":
				geomsymbol = e.GetInstanceGeometry()
				for sg in geomsymbol:
					try:
						result.append(sg.ToProtoType())
					except:
						if len(result) != 0:
							for r in result:
								try: r.Dispose()
								except: pass
							result = []
							break
			else:
				try:
					result.append(e.ToProtoType())		
				except:
					if len(result) != 0:
						for r in result:
							try: r.Dispose()
							except: pass
						result = []
						break
		if len(result) == 0:
			return False
		else:
			newresult = []
			for e in result:
				if e != None:
					newresult.append(e)
			if len(newresult) == 0:
				return False
			else:
				return newresult
	except:
		return "Fail"

def flatten(x):
    result = []
    try:
    	for el in x:
        	if hasattr(el, "__iter__") and not isinstance(el, basestring):
        	    result.extend(flatten(el))
        	else:
        	    result.append(el)
    except:
    	result = x
    return result

geom = UnwrapElement(IN[0])
if geom != None:
	geom = tolist(geom)
else:
	pass

temp_path = System.IO.Path.GetTempPath()
satOpt = DWGExportOptions()
impOpt = DWGImportOptions()
opt1 = Options()
opt1.ComputeReferences = True

#Find a 3D view type
collector1 = FilteredElementCollector(doc)
viewFamilyTypes = collector1.OfClass((ViewFamilyType))
for e in viewFamilyTypes:
	if str(e.ViewFamily) == "ThreeDimensional":
		viewType = e.Id
		break

def NewForm_background(s1):
	try:
		randomname = ''.join([random.choice(string.ascii_letters + string.digits) for n in xrange(5)])
		TransactionManager.Instance.ForceCloseTransaction()
		trans1 = Transaction(doc, 'Magic')
		trans1.Start()
		sat_path = '%s%s.dwg' % (temp_path, randomname)
		tid = []
		for each in s1:
			tid.append(each.Id)
		ielements = List[ElementId](tid)
		dupli = doc.ActiveView
		try:
			wantedsub = doc.Settings.Categories.get_Item(BuiltInCategory.OST_Mass)
			dupli.SetCategoryHidden(wantedsub.Id,False)
		except:
			pass
		try:
			dupli.IsolateElementsTemporary(ielements)
		except: pass
		try:
			dupli.ConvertTemporaryHideIsolateToPermanent()
		except: pass
		kilist = List[ElementId]([dupli.Id])
		doc.Export(temp_path, randomname, kilist, satOpt)
		trans1.RollBack()
	except:
		return traceback.format_exc(),''
		
	TransactionManager.Instance.EnsureInTransaction(doc)
	eachlist = doc.Import(sat_path, impOpt, doc.ActiveView)
	importinstance = doc.GetElement(eachlist[1])
	System.IO.File.Delete(sat_path)
	TransactionManager.Instance.TransactionTaskDone()
	return importinstance 

result = NewForm_background(geom)
OUT = result
satOpt.Dispose()
opt1.Dispose()
# ----------------------------------------
VARImportInstance = Output(python_script)
