# Dynamo custom node Element.Geometry Fixer Legacy.dyf (Dynamo 2.1.0.7500)
# category: Synthesize.Fixers
# Element.Geometry Fixer Legacy

VARElements = Input(VARElements: var[]..[])
geometry = Element.Geometry(element=VARElements)
VARGeometry = Output(geometry)
