# Dynamo custom node Expect Solid Only.dyf (Dynamo 2.1.0.7500)
# category: Synthesize.Automate.Solid
# Expect Solid Only

VARElement = Input(VARElement: var[]..[])
element_geometry_fixer = Custom[Element.Geometry Fixer](VARElement=VARElement)  # Element.Geometry Fixer
flatten = List.Flatten(list=element_geometry_fixer)
turnIntoList = Custom[CW.TurnIntoList](VARunknownItem=flatten)  # Turns an element (or a nested list) into a flat list
count = List.Count(list=turnIntoList)
code_block = CodeBlock { 1; }
eq = count == code_block
empty = List.Empty()
scopeIf = Custom[CW.ScopeIf+](VARtest=eq, VARtrue=empty, VARfalse=VARElement)  # A (hopefully) more robust implementation of ScopeIf. Tests a single boolean and returns a value accordingly.
geometry = Element.Geometry(element=scopeIf)
scopeIf_2 = Custom[CW.ScopeIf+](VARtest=eq, VARtrue=turnIntoList, VARfalse=geometry)
flatten_2 = List.Flatten(list=scopeIf_2)
VARSolid = Output(flatten_2)
