# Dynamo custom node Family Parameters Randomize.dyf (Dynamo 2.1.0.7500)
# category: Synthesize.Automate.Parameter
# Family Parameters Randomize

VARfamilyParameters = Input(VARfamilyParameters: var[]..[])
VARListofParameterstoRandomize = Input(VARListofParameterstoRandomize: var[]..[])
count = List.Count(list=VARListofParameterstoRandomize)
ofRepeatedItem = List.OfRepeatedItem(item=VARfamilyParameters, amount=count)
VARNameofFamilyParameter = Input(VARNameofFamilyParameter: var[]..[])
eq = VARNameofFamilyParameter == VARListofParameterstoRandomize@L1
filterByBoolMask = List.FilterByBoolMask(list=ofRepeatedItem, mask=eq)
flatten = List.Flatten(list=filterByBoolMask.in)
VARAdditive = Input(VARAdditive: var[]..[])
VARIntegernumbersofRandomizing = Input(VARIntegernumbersofRandomizing: var[]..[])
VARMinimumValue = Input(VARMinimumValue: var[]..[])
VARMaximumValue = Input(VARMaximumValue: var[]..[])
count_2 = List.Count(list=flatten)
randomIntegerMin = Custom[LF.Math.RandomIntegerMin](VARmin=VARMinimumValue, VARmax=VARMaximumValue, VARamount=count_2)  # Creates a list of random integers between a given minimum and maximum value
random = Math.Random(value1=VARMinimumValue, value2=VARMaximumValue)
lb_lunchbox_random_numbers = Custom[LB.LunchBox Random Numbers](VARMin=VARMinimumValue, VARMax=VARMaximumValue, VARAmount=count_2, VARSeed=random)  # Generates a list of Random numbers using a domain, amount, and seed.
scopeIf = Custom[CW.ScopeIf+](VARtest=VARIntegernumbersofRandomizing, VARtrue=randomIntegerMin, VARfalse=lb_lunchbox_random_numbers)  # A (hopefully) more robust implementation of ScopeIf. Tests a single boolean and returns a value accordingly.
VARRounding = Input(VARRounding: var[]..[])
roundToPrecision = Custom[CW.Math.RoundToPrecision](VARdbl=scopeIf, VARprecision=VARRounding)  # Rounds a number to a specified precision
VARAssociatedParameters = Input(VARAssociatedParameters: var[]..[])
ofRepeatedItem_2 = List.OfRepeatedItem(item=VARAssociatedParameters, amount=count)
filterByBoolMask_2 = List.FilterByBoolMask(list=ofRepeatedItem_2, mask=eq)
python_empty_2_null = Custom[Python Empty 2 Null](VARIN=filterByBoolMask_2.in@L3)  # Python Null 2 Empty
firstItem = List.FirstItem(list=python_empty_2_null@L2)
python_script = Python(IN[0]=firstItem)
# ---------- python_script.python (17 lines) ----------
import clr
clr.AddReference('RevitAPI')
from Autodesk.Revit.DB import *

clr.AddReference("RevitNodes")
import Revit
clr.ImportExtensions(Revit.Elements)

params = UnwrapElement(IN[0])
pname = []

for each in params:
	try:
		pname.append(each.AsDouble())
	except:
		pname.append(None)
OUT = pname
# ----------------------------------------
unit_types = UnitTypes("Length")
displayUnitType = Custom[CW.UnitType.DisplayUnitType](VARunitType=unit_types)  # Retrieves the display unit type for a given unit type.
toDisplayUnit = Custom[CW.InternalUnit.ToDisplayUnit](VARval=python_script, VARdisplayUnitType=displayUnitType.VARdisplayUnitType)  # Converts a value from Revit's internal unit to a given display unit
isNull = Object.IsNull(obj=toDisplayUnit)
filterByBoolMask_3 = List.FilterByBoolMask(list=roundToPrecision, mask=isNull)
filterByBoolMask_4 = List.FilterByBoolMask(list=toDisplayUnit, mask=isNull)
add = filterByBoolMask_3.out + filterByBoolMask_4.out
mergeByBoolMask = Custom[SP.List.MergeByBoolMask](VARIn=filterByBoolMask_3.in, VAROut=add, VARmask=isNull)  # Merge two lists by a boolean mask list. The true count in the mask should be the same as the length of the true list and vice versa for the false list.
scopeIf_2 = Custom[CW.ScopeIf+](VARtest=VARAdditive, VARtrue=mergeByBoolMask, VARfalse=roundToPrecision)
toInternalUnit = Custom[CW.DisplayUnit.ToInternalUnit](VARval=scopeIf_2, VARdisplayUnitType=displayUnitType.VARdisplayUnitType)  # Converts a value from a given display unit to Revit's internal unit
python_script_2 = Python(IN[0]=flatten, IN[1]=toInternalUnit)
# ---------- python_script_2.python (60 lines) ----------
# Enable Python support and load DesignScript library
# IMPORTANT : ALL DYNAMO DESIGN SCRIPT NODES ARE AS (dg)
import clr
clr.AddReference('ProtoGeometry')
from Autodesk.DesignScript import Geometry as dg

# EXTENSION Enable ToDSType
clr.AddReference('RevitNodes')
import Revit
clr.ImportExtensions(Revit.Elements)

# Enable Revit Elements
from Revit.Elements import *

# EXTENSION Enable Geometry Conversion Methods
clr.ImportExtensions(Revit.GeometryConversion)

# Enable Revit API
clr.AddReference('RevitAPI')
from Autodesk.Revit.DB import *

# Enable DocumentManager and TransactionManager
clr.AddReference('RevitServices')
from RevitServices.Persistence import DocumentManager
from RevitServices.Transactions import TransactionManager

# Enable ICollection List Translate
clr.AddReference("System")
import System.Collections.Generic
from System.Collections.Generic import List

# Use UnwrapElement(IN[0]) When Translating From Dynamo to Revit
params = UnwrapElement(IN[0])
value = UnwrapElement(IN[1])

# Choose The Current Document
doc = DocumentManager.Instance.CurrentDBDocument
uidoc = DocumentManager.Instance.CurrentUIApplication.ActiveUIDocument
uiapp = DocumentManager.Instance.CurrentUIApplication
app = uiapp.Application

# Create Empty List
result = []

# Start a Transaction with Current Document (doc)
TransactionManager.Instance.EnsureInTransaction(doc)

count = 0
for each in params:
	try:
		doc.FamilyManager.Set(each, value[count])
		count = count + 1
		result.append("SUCCESS")
	except:
		result.append("ERROR")
# End the Transaction with Current Document ()
TransactionManager.Instance.TransactionTaskDone()

# Assign your output to the OUT variable.
OUT = result
# ----------------------------------------
VARReport = Output(python_script_2)
VARValuesGenerated = Output(scopeIf_2)
code_block = CodeBlock { false; }
clean = List.Clean(list=filterByBoolMask_2.in, preserveIndices=code_block)
flatten_2 = List.Flatten(list=clean)
count_3 = List.Count(list=flatten_2)
VARNumberofAssociatedElements = Output(count_3)
