# Dynamo custom node Family SAT Sync.dyf (Dynamo 2.1.0.7500)
# category: Synthesize.Automate.Fusion 360
# Fusion 360 SAT Sync

VARAternativeMode = Input(VARAternativeMode: var[]..[])
VARExplode = Input(VARExplode: bool = false)
VARJoinSolids = Input(VARJoinSolids: var[]..[])
empty = List.Empty()
VARSwitchYToZUpOrientation = Input(VARSwitchYToZUpOrientation: var[]..[])
VARJoinSurfaces = Input(VARJoinSurfaces: var[]..[])
VARExportedSATFile = Input(VARExportedSATFile: var[]..[])
empty_2 = List.Empty()
scopeIf = Custom[CW.ScopeIf+](VARtest=VARAternativeMode, VARtrue=VARExportedSATFile, VARfalse=empty_2)  # A (hopefully) more robust implementation of ScopeIf. Tests a single boolean and returns a value accordingly.
better_geometry_importfromsat = Custom[Better Geometry.ImportFromSAT](VARSATFile=scopeIf)  # Better Geometry.ImportFromSAT
code_block = CodeBlock { "Surface"; "Solid"; }
byClassName = Custom[SP.Filter.ByClassName](VARobject=better_geometry_importfromsat, VARclassName=code_block.out0)  # Filters a list of objects by the object's class name. Note that Dynamo elements belong to different classes than their Revit counterparts. Use the Object.Class node to check an object's class.
code_block_2 = CodeBlock { null; }
scopeIf_2 = Custom[CW.ScopeIf+](VARtest=VARJoinSurfaces, VARtrue=byClassName.VARin, VARfalse=code_block_2)
join_adjacent_surfaces = Custom[Join Adjacent Surfaces](VARSurfaces=scopeIf_2)  # Join Adjacent Surfaces
flatten = List.Flatten(list=join_adjacent_surfaces)
scopeIf_3 = Custom[CW.ScopeIf+](VARtest=VARJoinSurfaces, VARtrue=flatten, VARfalse=byClassName.VARin)
byClassName_2 = Custom[SP.Filter.ByClassName](VARobject=byClassName.VARout, VARclassName=code_block.out1)
create = List.Create(item0=scopeIf_3, item1=byClassName_2.VARin)
code_block_3 = CodeBlock { false; }
clean = List.Clean(list=create, preserveIndices=code_block_3)
flatten_2 = List.Flatten(list=clean)
flip_y_axis = Custom[Flip Y Axis](VARgeometry=flatten_2)  # Flip Y Axis
scopeIf_4 = Custom[CW.ScopeIf+](VARtest=VARSwitchYToZUpOrientation, VARtrue=flip_y_axis, VARfalse=flatten_2)
VARXScale = Input(VARXScale: var[]..[])
VARYScale = Input(VARYScale: var[]..[])
VARZScale = Input(VARZScale: var[]..[])
scale = Geometry.Scale(geometry=scopeIf_4, xamount=VARXScale, yamount=VARYScale, zamount=VARZScale)
scopeIf_5 = Custom[CW.ScopeIf+](VARtest=VARJoinSolids, VARtrue=empty, VARfalse=scale)
scopeIf_6 = Custom[CW.ScopeIf+](VARtest=VARJoinSolids, VARtrue=scale, VARfalse=empty)
solid_byunion_fixer = Custom[Solid.ByUnion Fixer](VARsolids=scopeIf_6)  # Solid.ByUnion Fixer
create_2 = List.Create(item0=scopeIf_5, item1=solid_byunion_fixer)
code_block_4 = CodeBlock { false; }
clean_2 = List.Clean(list=create_2, preserveIndices=code_block_4)
flatten_3 = List.Flatten(list=clean_2)
empty_3 = List.Empty()
scopeIf_7 = Custom[CW.ScopeIf+](VARtest=VARExplode, VARtrue=flatten_3, VARfalse=empty_3)
explode = Geometry.Explode(geometry=scopeIf_7)
scopeIf_8 = Custom[CW.ScopeIf+](VARtest=VARExplode, VARtrue=explode, VARfalse=flatten_3)
scopeIf_9 = Custom[CW.ScopeIf+](VARtest=VARAternativeMode, VARtrue=scopeIf_8, VARfalse=empty_3)
flatten_4 = List.Flatten(list=scopeIf_9)
VARFamilyTemplate = Input(VARFamilyTemplate: var[]..[])
VARFamilyName = Input(VARFamilyName: var[]..[])
code_block_5 = CodeBlock { " "; }
VARFamilyNumber = Input(VARFamilyNumber: var[]..[])
code_block_6 = CodeBlock(a=VARFamilyName, b=code_block_5, c=VARFamilyNumber) { a+b+c; }
VARCategorys = Input(VARCategorys: var[]..[])
VARmaterialName = Input(VARmaterialName: var[] = null)
VARisVoid = Input(VARisVoid: var[] = false)
VARsubcategoryName = Input(VARsubcategoryName: var[] = null)
VARisShared = Input(VARisShared: var[] = false)
byName = Family.ByName(name=code_block_6)
isNull = Object.IsNull(obj=byName)
code_block_7 = CodeBlock { true; }
ne = isNull != code_block_7
types = Family.Types(family=byName)
all_elements_of_family_type = ElementsOfFamilyType(Family_Type=types)
flatten_5 = List.Flatten(list=all_elements_of_family_type)
count = List.Count(list=flatten_5)
code_block_8 = CodeBlock { 0; }
eq = count == code_block_8
eq_2 = isNull == code_block_7
scopeIf_10 = Custom[CW.ScopeIf+](VARtest=ne, VARtrue=eq, VARfalse=eq_2)
VARPositionSystemFalseIsInstanceOriginTr = Input(VARPositionSystemFalseIsInstanceOriginTrueIsRelativeToProjectOrigin: bool = true)
VAROneMat = Input(VAROneMat: bool = false)
VARIsInstanceMat = Input(VARIsInstanceMat: bool = true)
byGeometry = Custom[SP.FamilyInstance.ByGeometry](VARgeometry=flatten_4, VARfamilyTemplatePath=VARFamilyTemplate, VARfamilyName=code_block_6, VARcategory=VARCategorys, VARmaterialName=VARmaterialName, VARisVoid=VARisVoid, VARsubcategoryName=VARsubcategoryName, VARisShared=VARisShared, VARPlaceInstance=scopeIf_10, VARPositionSystemFalseIsInstanceOriginTrueRelativeToProjectOrigin=VARPositionSystemFalseIsInstanceOriginTr, VARonemat=VAROneMat, VARIsInstanceMat=VARIsInstanceMat)  # You must provide a valid family template path that will be used for all input geometry objects. The project units(and not the templates) will be used to determine the size of the output geometry. The provided category will be used only if the family template supports it. If not, the default template category will be used instead. Likewise, the family material(provided as a string) will be set only if a material with that name exists in the template. If not, the default material will be used instead ("By Category"). For void cuts, the material settings will be ignored. The Subcategory name is an optional input. If you'd like to skip assigning a Subcategory to any new instance, simply use null. The node expects a unique family name for each geometry object. The rest of the input lists will be processed as if the node lacing is set to longest.
scopeIf_11 = Custom[CW.ScopeIf+](VARtest=VARAternativeMode, VARtrue=empty_3, VARfalse=VARExportedSATFile)
bySAT = Custom[SP.FamilyInstance.BySAT](VARSAT=scopeIf_11, VARfamilyTemplatePath=VARFamilyTemplate, VARfamilyName=code_block_6, VARcategory=VARCategorys, VARmaterialName=VARmaterialName, VARisVoid=VARisVoid, VARsubcategoryName=VARsubcategoryName, VARisShared=VARisShared, VARPlaceInstance=scopeIf_10, VARPositionSystemFalseIsInstanceOriginTrueRelativeToProjectOrigin=VARPositionSystemFalseIsInstanceOriginTr, VARonemat=VAROneMat, VARIsInstanceMat=VARIsInstanceMat)  # You must provide a valid family template path that will be used for all input geometry objects. The project units(and not the templates) will be used to determine the size of the output geometry. The provided category will be used only if the family template supports it. If not, the default template category will be used instead. Likewise, the family material(provided as a string) will be set only if a material with that name exists in the template. If not, the default material will be used instead ("By Category"). For void cuts, the material settings will be ignored. The Subcategory name is an optional input. If you'd like to skip assigning a Subcategory to any new instance, simply use null. The node expects a unique family name for each geometry object. The rest of the input lists will be processed as if the node lacing is set to longest.
create_3 = List.Create(item0=byGeometry.VARinstance, item1=bySAT.VARinstance)
code_block_9 = CodeBlock { false; }
clean_3 = List.Clean(list=create_3, preserveIndices=code_block_9)
flatten_6 = List.Flatten(list=clean_3)
VARInstance = Output(flatten_6)
create_4 = List.Create(item0=byGeometry.VARfamily, item1=bySAT.VARfamily)
clean_4 = List.Clean(list=create_4, preserveIndices=code_block_9)
flatten_7 = List.Flatten(list=clean_4)
VARFamily = Output(flatten_7)
