# Dynamo custom node Fix Room Heights Data.dyf (Dynamo 2.1.0.7500)
# category: Synthesize.Automate.Coordination
# Fix Room Heights Data

VARRooms = Input(VARRooms: var[]..[])
python_script = Python(IN[0]=VARRooms)
# ---------- python_script.python (91 lines) ----------
# Enable Python support and load DesignScript library
# IMPORTANT : ALL DYNAMO DESIGN SCRIPT NODES ARE AS (dg)
import clr
clr.AddReference('ProtoGeometry')
from Autodesk.DesignScript import Geometry as dg
clr.AddReference("RevitAPIUI")
from Autodesk.Revit.UI import TaskDialog

# EXTENSION Enable ToDSType
clr.AddReference('RevitNodes')
import Revit
clr.ImportExtensions(Revit.Elements)

# Enable Revit Elements
from Revit.Elements import *

# EXTENSION Enable Geometry Conversion Methods
clr.ImportExtensions(Revit.GeometryConversion)

# Enable Revit API
clr.AddReference('RevitAPI')
from Autodesk.Revit.DB import *

# Enable DocumentManager and TransactionManager
clr.AddReference('RevitServices')
from RevitServices.Persistence import DocumentManager
from RevitServices.Transactions import TransactionManager

# Enable ICollection List Translate
clr.AddReference("System")
import System.Collections.Generic

def tolist(obj1):
	if hasattr(obj1,'__iter__'): return obj1
	else: return [obj1]

doc = DocumentManager.Instance.CurrentDBDocument
uiapp = DocumentManager.Instance.CurrentUIApplication
app = uiapp.Application

dataEnteringNode = IN
# Use UnwrapElement(IN[0]) When Translating From Dynamo to Revit
inside=UnwrapElement(tolist(IN[0]))

if int(DocumentManager.Instance.CurrentUIApplication.Application.VersionNumber) < 2021:
	formatoptions = doc.GetUnits().GetFormatOptions(UnitType.UT_Length)
	dispunits = formatoptions.DisplayUnits
	factor = UnitUtils.ConvertFromInternalUnits(1, dispunits)
else:
	factor = UnitUtils.ConvertFromInternalUnits(1,doc.GetUnits().GetFormatOptions(SpecTypeId.Length).GetUnitTypeId())

# Create Empty List
resultlimitoffset = []
resultbaseoffset = []
resultlimitlevels = []

for e in inside:
	currentlevel = doc.GetElement(e.get_Parameter(BuiltInParameter.ROOM_LEVEL_ID).AsElementId())
	leveltype = doc.GetElement(currentlevel.GetTypeId())
	relativeto = leveltype.get_Parameter(BuiltInParameter.LEVEL_RELATIVE_BASE_TYPE).AsValueString()
	if relativeto == "Survey Point":
		if int(DocumentManager.Instance.CurrentUIApplication.Application.VersionNumber) < 2020:
		    collector = FilteredElementCollector(doc).OfClass(BasePoint)
		    for current in collector:
				if (current.IsShared):
					difference = current.Position.Z
					break
		else:
			difference = BasePoint.GetSurveyPoint(doc).Position.Z
	else:
		if int(DocumentManager.Instance.CurrentUIApplication.Application.VersionNumber) < 2020:
		    collector = FilteredElementCollector(doc).OfClass(BasePoint)
		    for current in collector:
				if (current.IsShared == False):
					difference = current.Position.Z
					break
		else:
			difference = BasePoint.GetProjectBasePoint(doc).Position.Z
	levelelevation = currentlevel.Elevation + difference
	g1 = e.get_BoundingBox(None).Max.Z
	g2 = e.get_BoundingBox(None).Min.Z
	gtotal = g1 - g2
	gdif = g2 - levelelevation
	gtotal += gdif
	fixedgtotal = gtotal*factor
	fixedbase = gdif*factor
	resultlimitoffset.append(fixedgtotal)
	resultbaseoffset.append(fixedbase)
	resultlimitlevels.append(currentlevel)
# Assign your output to the OUT variable.
OUT = resultlimitoffset,resultbaseoffset,resultlimitlevels
# ----------------------------------------
code_block = CodeBlock(res=python_script) { res[0]; res[1]; res[2]; }
VARLimitOffsets = Output(code_block.out0)
VARBaseOffsets = Output(code_block.out1)
VARUpperLimitLevels = Output(code_block.out2)
