# Dynamo custom node Flatten Nurbs Surfaces.dyf (Dynamo 2.1.0.7500)
# category: Synthesize.Automate.Surface
# Flatten Nurbs Surfaces

VARBaseSurface = Input(VARBaseSurface: var[]..[])
turnIntoList = Custom[CW.TurnIntoList](VARunknownItem=VARBaseSurface)  # Turns an element (or a nested list) into a flat list
code_block = CodeBlock(a=turnIntoList) { a[0]; }
VARSurfacesToFlatten = Input(VARSurfacesToFlatten: var[]..[])
surface_importer = Custom[Surface Importer](VARSurfaces=VARSurfacesToFlatten)  # Surface Importer Node
surfaces = PolySurface.Surfaces(polySurface=surface_importer)
flatten = List.Flatten(list=surfaces)
perimeterCurves = Surface.PerimeterCurves(surface=flatten)
length = Curve.Length(curve=perimeterCurves)
VARResolution = Input(VARResolution: double = 0.1)
div = length / VARResolution
round = Math.Round(number=div)
sequence = Sequence(amount=round, lacing=Longest)
code_block_2 = CodeBlock { 0; 1; }
remapRange = Math.RemapRange(numbers=sequence, newMin=code_block_2.out0, newMax=code_block_2.out1)
pointAtParameter = Curve.PointAtParameter(curve=perimeterCurves, param=remapRange)
UVParameterAtPoint = Surface.UVParameterAtPoint(surface=flatten, point=pointAtParameter)
U = UV.U(uV=UVParameterAtPoint)
V = UV.V(uV=UVParameterAtPoint)
pointAtParameter_2 = Surface.PointAtParameter(surface=code_block, u=U, v=V)
byControlPoints = NurbsCurve.ByControlPoints(points=pointAtParameter_2)
as_polycurve_bycurves = Custom[AS.[&] PolyCurve.ByCurves](VARcurves=byControlPoints)  # Create polycurves from an unordered list of curves.
byPatch = Surface.ByPatch(closedCurve=as_polycurve_bycurves.VARpolyCurve)
area = Surface.Area(surface=byPatch)
maximumItem = List.MaximumItem(list=area)
eq = maximumItem == area
filterByBoolMask = List.FilterByBoolMask(list=byPatch, mask=eq)
join = List.Join()  # unwired: list0, list1
perimeterCurves_2 = Surface.PerimeterCurves(surface=filterByBoolMask.in)
byJoinedCurves = PolyCurve.ByJoinedCurves(curves=perimeterCurves_2)
perimeterCurves_3 = Surface.PerimeterCurves(surface=filterByBoolMask.out)
byJoinedCurves_2 = PolyCurve.ByJoinedCurves(curves=perimeterCurves_3)
turnIntoList_2 = Custom[CW.TurnIntoList](VARunknownItem=byJoinedCurves_2)
python_empty_2_null = Custom[Python Empty 2 Null](VARIN=turnIntoList_2)  # Python Null 2 Empty
code_block_3 = CodeBlock { 2; }
normalizeDepth = List.NormalizeDepth(list=python_empty_2_null, rank=code_block_3)
combine = List.Combine(comb=join, list1=byJoinedCurves, list2=normalizeDepth)
trimWithEdgeLoops = Surface.TrimWithEdgeLoops(surface=filterByBoolMask.in, loops=combine)
VARSurfaces = Output(trimWithEdgeLoops)
