# Dynamo custom node Flip Parameter Values.dyf (Dynamo 2.1.0.7500)
# category: Synthesize.Automate.Parameter
# Flip Parameter Values

VARProceed = Input(VARProceed: var[]..[])
VARIsTypeParameters = Input(VARIsTypeParameters: var[]..[])
VARElementstoWorkon = Input(VARElementstoWorkon: var[]..[])
elementType = Element.ElementType(element=VARElementstoWorkon)
uniqueItems = List.UniqueItems(list=elementType)
scopeIf = Custom[CW.ScopeIf+](VARtest=VARIsTypeParameters, VARtrue=uniqueItems, VARfalse=VARElementstoWorkon)  # A (hopefully) more robust implementation of ScopeIf. Tests a single boolean and returns a value accordingly.
flatten = List.Flatten(list=scopeIf)
code_block = CodeBlock { false; }
clean = List.Clean(list=flatten, preserveIndices=code_block)
ID = Custom[CW.Element.ID](VARelement=clean)  # Gets the ID(s) for a list of Revit elements (or a single element) - unlike the built-in Element.Id node, this node returns an actual Revit Element ID and *not* a number
number = DoubleInput(0)
count = List.Count(list=ID.VARID)
number_2 = DoubleInput(1)
sequence = Sequence(start=number, amount=count, step=number_2, lacing=Longest)
getItemAtIndex = List.GetItemAtIndex(list=ID.VARID, index=sequence)
byID = Custom[CW.Element.ByID](VARIDUniqueId=getItemAtIndex)  # Gets the Revit element(s) for a list of IDs (or a single ID)
code_block_2 = CodeBlock { null; }
scopeIf_2 = Custom[CW.ScopeIf+](VARtest=VARProceed, VARtrue=byID, VARfalse=code_block_2)
code_block_3 = CodeBlock { false; }
clean_2 = List.Clean(list=scopeIf_2, preserveIndices=code_block_3)
flatten_2 = List.Flatten(list=clean_2)
VARListofParameterstoFlip = Input(VARListofParameterstoFlip: var[]..[])
uniqueItems_2 = List.UniqueItems(list=VARListofParameterstoFlip)
parameterExists = Custom[CW.Element.ParameterExists](VARparam=uniqueItems_2, VARelement=clean)  # Checks if an element contains a parameter of a given name
allTrue = List.AllTrue(list=parameterExists@L2)
filterByBoolMask = List.FilterByBoolMask(list=uniqueItems_2, mask=allTrue)
scopeIf_3 = Custom[CW.ScopeIf+](VARtest=VARProceed, VARtrue=filterByBoolMask.in, VARfalse=code_block_2)
clean_3 = List.Clean(list=scopeIf_3, preserveIndices=code_block_3)
getParameterValueByName = Element.GetParameterValueByName(element=clean_2, parameterName=clean_3@L1)
code_block_4 = CodeBlock { -1; }
mul = getParameterValueByName * code_block_4
flatten_3 = List.Flatten()  # unwired: list
map = List.Map(list=mul, f_x=flatten_3)
setParameterByName = Element.SetParameterByName(element=flatten_2, parameterName=clean_3@L1, value=map@L2)
VARElementstoselect = Output(clean)
count_2 = List.Count(list=byID)
VARNumberofElements = Output(count_2)
