# Dynamo custom node Flip Section.dyf (Dynamo 2.1.0.7500)
# category: Synthesize.Automate.Views
# Flip Section

VARSectionView = Input(VARSectionView: var[]..[])
python_script = Python(IN[0]=VARSectionView)
# ---------- python_script.python (62 lines) ----------
import clr
clr.AddReference('RevitAPI')
import Autodesk
from Autodesk.Revit.DB import *

clr.AddReference("RevitServices")
import RevitServices
from RevitServices.Persistence import DocumentManager
from RevitServices.Transactions import TransactionManager

doc = DocumentManager.Instance.CurrentDBDocument

clr.AddReference("RevitNodes")
import Revit
clr.ImportExtensions(Revit.GeometryConversion)

clr.AddReference('ProtoGeometry')
from Autodesk.DesignScript.Geometry import *

from System.Collections.Generic import *

sections = IN[0]
if not isinstance(sections,list):
	sections = [sections]


#get View Plane to use as the Mirror Plane
def getPlane(s):
	s = UnwrapElement(s)
	origin = s.Origin
	normal = s.ViewDirection
	plane = Autodesk.Revit.DB.Plane.CreateByNormalAndOrigin(normal,origin)
	return plane


#get the Element ID for the Section View's Annotative Viewer
def getViewer(s):
	viewerId = ElementId(s.Id - 1)
	return viewerId

def flipSection(s):
	ids = []
	ids.append(getViewer(s))
	Icoll = List[ElementId](ids)
	rp = getPlane(s)
	ElementTransformUtils.MirrorElements(doc, Icoll, rp, False)
	return s
	
count = 0

TransactionManager.Instance.EnsureInTransaction(doc)

for s in sections:
	try:
		flipSection(s)
		count = count + 1
	except:
		pass

TransactionManager.Instance.TransactionTaskDone()

OUT = "%s elements mirrored" %count, sections
# ----------------------------------------
VARSectionView_2 = Output(python_script)  # "VARSectionView"
