# Dynamo custom node Flip Y Axis.dyf (Dynamo 2.1.0.7500)
# category: Synthesize.Automate.Geometry
# Flip Y Axis

VARFliporNot = Input(VARFliporNot: bool = true)
VARgeometry = Input(VARgeometry: var[]..[])
empty = List.Empty()
scopeIf = Custom[CW.ScopeIf+](VARtest=VARFliporNot, VARtrue=VARgeometry, VARfalse=empty)  # A (hopefully) more robust implementation of ScopeIf. Tests a single boolean and returns a value accordingly.
number = DoubleInput(1)
byCoordinates = Vector.ByCoordinates(y=number, z=number)
byOriginNormal = Plane.ByOriginNormal(normal=byCoordinates)
number_2 = DoubleInput(180)
rotate = Geometry.Rotate(geometry=scopeIf, basePlane=byOriginNormal, degrees=number_2)
scopeIf_2 = Custom[CW.ScopeIf+](VARtest=VARFliporNot, VARtrue=rotate, VARfalse=VARgeometry)
VARGeometry = Output(scopeIf_2)
