# Dynamo custom node FlipWorkplane.dyf (Dynamo 2.1.0.7500)
# category: Synthesize.Automate.Family
# FlipWorkplane

VARElements = Input(VARElements: var[]..[])
VARFlip = Input(VARFlip: bool = false)
python_script = Python(IN[0]=VARElements, IN[1]=VARFlip)
# ---------- python_script.python (46 lines) ----------
# Enable Python support and load DesignScript library
# IMPORTANT : ALL DYNAMO DESIGN SCRIPT NODES ARE AS (dg)
import clr

# EXTENSION Enable ToDSType
clr.AddReference('RevitNodes')
import Revit
clr.ImportExtensions(Revit.Elements)

# Enable Revit API
clr.AddReference('RevitAPI')
from Autodesk.Revit.DB import *

# Enable DocumentManager and TransactionManager
clr.AddReference('RevitServices')
from RevitServices.Persistence import DocumentManager
from RevitServices.Transactions import TransactionManager

def flipwp(elem,mode):
	elem.IsWorkPlaneFlipped = mode

def tolist(obj1):
	if hasattr(obj1,'__iter__'): return obj1
	else: return [obj1]
	
# Use UnwrapElement(IN[0]) When Translating From Dynamo to Revit
elems = UnwrapElement(tolist(IN[0]))
mode = IN[1]

# Choose The Current Document
doc = DocumentManager.Instance.CurrentDBDocument

# Start a Transaction with Current Document (doc)
TransactionManager.Instance.EnsureInTransaction(doc)
result = []
for e in elems:
	try:
		flipwp(e,mode)
		result.append("SUCCESS")
	except:
		result.append("ERROR")
# End the Transaction with Current Document ()
TransactionManager.Instance.TransactionTaskDone()

# Assign your output to the OUT variable.
OUT = result
# ----------------------------------------
VAROut = Output(python_script)
