# Dynamo custom node Floors By Model Lines.dyf (Dynamo 2.1.0.7500)
# category: Synthesize.Automate.Floors
# Floors By Model Lines

VARConsiderInnerModelLinesAsOpennings = Input(VARConsiderInnerModelLinesAsOpennings: var[]..[])
VARElement = Input(VARElement: var[]..[])
elements_curves_fixer = Custom[Elements.Curves Fixer](VARElement=VARElement)  # Elements.Curves Fixer
flatten = List.Flatten(list=elements_curves_fixer)
as_polycurve_bycurves = Custom[AS.[&] PolyCurve.ByCurves](VARcurves=flatten)  # Create polycurves from an unordered list of curves.
code_block = CodeBlock { false; }
clean = List.Clean(list=as_polycurve_bycurves.VARpolyCurve, preserveIndices=code_block)
closeWithLine = PolyCurve.CloseWithLine(polyCurve=clean)
curves = PolyCurve.Curves(polyCurve=closeWithLine)
firstItem = List.FirstItem(list=curves@L2)
intersect = Geometry.Intersect(geometry=firstItem, other=clean)
isNull = Object.IsNull()  # unwired: obj
replaceByCondition = Replace(item=intersect, replaceWith=firstItem, condition=isNull)
python_script = Python(IN[0]=replaceByCondition, IN[1]=firstItem)
# ---------- python_script.python (45 lines) ----------
# Load the Python Standard and DesignScript Libraries
import sys
import clr
clr.AddReference('ProtoGeometry')
from Autodesk.DesignScript.Geometry import *

# The inputs to this node will be stored as a list in the IN variables.
dataEnteringNode = IN
lists = UnwrapElement(IN[0])
curves = UnwrapElement(IN[1])

newlists = []
boolall = []
count = 0
for l in lists:
	currentcurve = curves[count]
	stp = currentcurve.StartPoint
	ste = currentcurve.EndPoint
	X1 = stp.X
	Y1 = stp.Y
	Z1 = stp.Z
	X2 = ste.X
	Y2 = ste.Y
	Z2 = ste.Z
	booltmp = []
	tmplist = []
	for k in l:
		if hasattr(k, 'X'):
			XTAR = k.X
			YTAR = k.Y
			ZTAR = k.Z
			if (round(X1,1) != round(XTAR,1) or round(Y1,1) != round(YTAR,1) or round(Z1,1) != round(ZTAR,1)) and (round(X2,1) != round(XTAR,1) or round(Y2,1) != round(YTAR,1) or round(Z2,1) != round(ZTAR,1)):
				tmplist.append(k)
				booltmp.append(True)
			else:
				tmplist.append(None)
				booltmp.append(False)
		else:
			tmplist.append(None)
			booltmp.append(False)
	newlists.append(tmplist)
	boolall.append(booltmp)
	count += 1
# Assign your output to the OUT variable.
OUT = newlists,boolall
# ----------------------------------------
code_block_2 = CodeBlock(a=python_script) { a[0]; a[1]; }
splitByPoints = Curve.SplitByPoints(curve=clean, points=code_block_2.out0)
uniqueItems = List.UniqueItems(list=splitByPoints@L2)
as_polycurve_bycurves_2 = Custom[AS.[&] PolyCurve.ByCurves](VARcurves=uniqueItems@@L1)
code_block_3 = CodeBlock { false; }
clean_2 = List.Clean(list=as_polycurve_bycurves_2.VARpolyCurve, preserveIndices=code_block_3)
flatten_2 = List.Flatten(list=clean_2@L3)
anyTrue = Custom[CW.List.AnyTrue](VARseq=code_block_2.out1)  # Returns true if any item in a list of booleans is true.
filterByBoolMask = List.FilterByBoolMask(list=closeWithLine, mask=anyTrue)
mergeByBoolMask = Custom[SP.List.MergeByBoolMask](VARIn=flatten_2, VAROut=filterByBoolMask.out, VARmask=anyTrue)  # Merge two lists by a boolean mask list. The true count in the mask should be the same as the length of the true list and vice versa for the false list.
flatten_3 = List.Flatten(list=mergeByBoolMask)
startPoint = Curve.StartPoint(curve=flatten_3)
byOriginNormal = Plane.ByOriginNormal(origin=startPoint)
pullOntoPlane = Curve.PullOntoPlane(curve=flatten_3, plane=byOriginNormal)
explode = Geometry.Explode(geometry=pullOntoPlane)
byJoinedCurves = PolyCurve.ByJoinedCurves(curves=explode)
empty = List.Empty()
scopeIf = Custom[CW.ScopeIf+](VARtest=VARConsiderInnerModelLinesAsOpennings, VARtrue=byJoinedCurves, VARfalse=empty)  # A (hopefully) more robust implementation of ScopeIf. Tests a single boolean and returns a value accordingly.
floor_opennings_prepare = Custom[Floor Opennings Prepare](VARJoinedCurves=scopeIf)  # Floor Opennings Prepare
flatten_4 = List.Flatten(list=floor_opennings_prepare.VARNonOpenningHostsCurves)
scopeIf_2 = Custom[CW.ScopeIf+](VARtest=VARConsiderInnerModelLinesAsOpennings, VARtrue=flatten_4, VARfalse=byJoinedCurves)
VARFloorType = Input(VARFloorType: var[]..[])
VARUseAllLevelsIgnoresLevelsSelectionFil = Input(VARUseAllLevelsIgnoresLevelsSelectionFilter: var[]..[])
VARFixFactorDependsofProjectUnits1Formet = Input(VARFixFactorDependsofProjectUnits1Formetersforexampleand100forCentimeters: var[]..[])
VARLevelsSelectionFiltertoRead = Input(VARLevelsSelectionFiltertoRead: var[]..[])
VAROffset = Input(VAROffset: var[]..[])
create_floors_by_boundary_lines = Custom[Create Floors By Boundary Lines (Smart)](VARFloorsBoundariesPolycurves=scopeIf_2, VARFloorType=VARFloorType, VARUseAllLevelsIgnoresLevelsSelectionFilter=VARUseAllLevelsIgnoresLevelsSelectionFil, VARFixFactorDependsofProjectUnits1Formetersforexampleand100forCentimeters=VARFixFactorDependsofProjectUnits1Formet, VARLevelsSelectionFiltertoRead=VARLevelsSelectionFiltertoRead, VAROffset=VAROffset)  # Create Floors By Boundary Lines (Smart)
flatten_5 = List.Flatten(list=floor_opennings_prepare.VAROpenningHostsCurves)
scopeIf_3 = Custom[CW.ScopeIf+](VARtest=VARConsiderInnerModelLinesAsOpennings, VARtrue=flatten_5, VARfalse=empty)
create_floors_by_boundary_lines_2 = Custom[Create Floors By Boundary Lines (Smart)](VARFloorsBoundariesPolycurves=scopeIf_3, VARFloorType=VARFloorType, VARUseAllLevelsIgnoresLevelsSelectionFilter=VARUseAllLevelsIgnoresLevelsSelectionFil, VARFixFactorDependsofProjectUnits1Formetersforexampleand100forCentimeters=VARFixFactorDependsofProjectUnits1Formet, VARLevelsSelectionFiltertoRead=VARLevelsSelectionFiltertoRead, VAROffset=VAROffset)
add = create_floors_by_boundary_lines.VARNumberofFloorsCreated + create_floors_by_boundary_lines_2.VARNumberofFloorsCreated
VARNumberOfFloors = Output(add)
VARCreateSelectionFilter = Input(VARCreateSelectionFilter: var[]..[])
VARFilterNametoCreate = Input(VARFilterNametoCreate: var[]..[])
VAROverwriteExistingFilter = Input(VAROverwriteExistingFilter: var[]..[])
create = List.Create(item0=create_floors_by_boundary_lines.VARFloors, item1=create_floors_by_boundary_lines_2.VARFloors)
code_block_4 = CodeBlock { false; }
clean_3 = List.Clean(list=create, preserveIndices=code_block_4)
generate_selection_filter = Custom[Generate Selection Filter](VARCreateSelectionFilter=VARCreateSelectionFilter, VARFilterNametoCreate=VARFilterNametoCreate, VAROverwriteExistingFilter=VAROverwriteExistingFilter, VARElements=clean_3)  # Generate Selection FIlter
scopeIf_4 = Custom[CW.ScopeIf+](VARtest=VARConsiderInnerModelLinesAsOpennings, VARtrue=floor_opennings_prepare.VAROpenningCurves, VARfalse=empty)
byCurves = Custom[SP.FloorOpening.ByCurves](VARhost=create_floors_by_boundary_lines_2.VARFloors, VARcurves=scopeIf_4@L3, lacing=Longest)  # Create hosted floor opeinngs through the input floors. The second input is a list of sub-lists of the boundary curves.
create_2 = List.Create(item0=generate_selection_filter.VARSelectionSet, item1=create_floors_by_boundary_lines.VARFloors, item2=byCurves, item3=create_floors_by_boundary_lines_2.VARFloors)
code_block_5 = CodeBlock { false; }
clean_4 = List.Clean(list=create_2, preserveIndices=code_block_5)
flatten_6 = List.Flatten(list=clean_4)
VAROutput = Output(flatten_6)
