# Dynamo custom node Floors Offset And Separate Function.dyf (Dynamo 2.1.0.7500)
# category: Synthesize.Automate.Floors
# Floors Offset And Separate Function

VARJoinedFloorCurves = Input(VARJoinedFloorCurves: var[]..[])
watch = Watch(VARJoinedFloorCurves)
byPatch = Surface.ByPatch(closedCurve=watch)
count = List.Count(list=byPatch)
ofRepeatedItem = List.OfRepeatedItem(item=watch, amount=count)
doesIntersect = Geometry.DoesIntersect(geometry=byPatch@L1, other=byPatch)
filterByBoolMask = List.FilterByBoolMask(list=ofRepeatedItem, mask=doesIntersect)
ofRepeatedItem_2 = List.OfRepeatedItem(item=byPatch, amount=count)
filterByBoolMask_2 = List.FilterByBoolMask(list=ofRepeatedItem_2, mask=doesIntersect)
area = Surface.Area(surface=filterByBoolMask_2.in)
maximumItem = List.MaximumItem(list=area)
eq = area == maximumItem
filterByBoolMask_3 = List.FilterByBoolMask(list=filterByBoolMask.in, mask=eq)
flatten = List.Flatten(list=filterByBoolMask_3.in)
al_duplicate_item_indices = Custom[AL.Duplicate Item Indices](VARList=flatten)  # Searches an input list for duplicate entries and lists their index numbers. Couple with Get From List to delete duplicates from a list.
VARDuplicateIndices = Output(al_duplicate_item_indices.VARDuplicateIndices)
python_empty_2_null = Custom[Python Empty 2 Null](VARIN=filterByBoolMask_3.out)  # Python Null 2 Empty
rank = List.Rank(list=python_empty_2_null)
normalizeDepth = List.NormalizeDepth(list=python_empty_2_null, rank=rank)
itemAtIndex = Custom[SP.List.ItemAtIndex+](VARlist=normalizeDepth, VARindex=al_duplicate_item_indices.VARUniqueIndices)  # Identical to the built in node but works with negative indices
isNull = Object.IsNull(obj=itemAtIndex)
allTrue = List.AllTrue(list=isNull@L2)
filterByBoolMask_4 = List.FilterByBoolMask(list=itemAtIndex, mask=allTrue)
explode = Geometry.Explode(geometry=filterByBoolMask_4.out)
openning_curves = Watch(explode)
VAROpenningCurves = Output(openning_curves)
itemAtIndex_2 = Custom[SP.List.ItemAtIndex+](VARlist=filterByBoolMask_3.in, VARindex=al_duplicate_item_indices.VARUniqueIndices)
VARFloorTypes = Input(VARFloorTypes: var[]..[])
itemAtIndex_3 = Custom[SP.List.ItemAtIndex+](VARlist=VARFloorTypes, VARindex=al_duplicate_item_indices.VARUniqueIndices)
VARFloorLevels = Input(VARFloorLevels: var[]..[])
itemAtIndex_4 = Custom[SP.List.ItemAtIndex+](VARlist=VARFloorLevels, VARindex=al_duplicate_item_indices.VARUniqueIndices)
byOutlineTypeAndLevel = Floor.ByOutlineTypeAndLevel(outlineCurves=itemAtIndex_2, floorType=itemAtIndex_3, level=itemAtIndex_4, lacing=Longest)
filterByBoolMask_5 = List.FilterByBoolMask(list=byOutlineTypeAndLevel, mask=allTrue)
openning_host = Watch(filterByBoolMask_5.out)
VAROpenningHost = Output(openning_host)
pure_floors_indices = Watch(al_duplicate_item_indices.VARUniqueIndices)
VARPureFloorsIndices = Output(pure_floors_indices)
floor_types = Watch(itemAtIndex_3)
VARFloorTypes_2 = Output(floor_types)  # "VARFloorTypes"
floor_levels = Watch(itemAtIndex_4)
VARFloorLevels_2 = Output(floor_levels)  # "VARFloorLevels"
isNull_2 = Object.IsNull(obj=byOutlineTypeAndLevel)
failed_floors = Watch(isNull_2)
VARFailedFloors = Output(failed_floors)
all_floors = Watch(byOutlineTypeAndLevel)
VARAllFloors = Output(all_floors)
VAROpenningCurveBool = Output(allTrue)
VAROpenningCurveNotCleanedList = Output(itemAtIndex)
