# Dynamo custom node Floors Offset And Separate.dyf (Dynamo 2.13.1.3887)
# category: Synthesize.Automate.Floors
# Floors Offset And Separate
# packages: Synthesize toolkit 12.5.1

VARFloors = Input(VARFloors: var[]..[])
code_block = CodeBlock { "Floor"; }
byClassName = Custom[SP.Filter.ByClassName](VARobject=VARFloors, VARclassName=code_block)  # package Synthesize toolkit; Filters a list of objects by the object's class name. Note that Dynamo elements belong to different classes than their Revit counterparts. Use the Object.Class node to check an object's class.
elementSketch = Custom[SP.Collector.ElementSketch](VARelement=byClassName.VARin)  # package Synthesize toolkit; Get the actual sketch lines of a sketch based element (floor, ceiling, modified wall, etc.) . You can optionally fetch the matching model curves, however this might prove comptationally heavy on larger data sets.
python_script = Python(IN[0]=elementSketch.VARcurves, IN[1]=byClassName.VARin)  # IronPython2
# ---------- python_script.python (134 lines) ----------
# Created By Karam Baki : karam@aecedx.com
# Enable Python support and load DesignScript library
# IMPORTANT : ALL DYNAMO DESIGN SCRIPT NODES ARE AS (dg)
import clr
clr.AddReference('ProtoGeometry')
from Autodesk.DesignScript import Geometry as dg

# EXTENSION Enable ToDSType
clr.AddReference('RevitNodes')
import Revit
clr.ImportExtensions(Revit.Elements)

# Enable Revit Elements
from Revit.Elements import *

# EXTENSION Enable Geometry Conversion Methods
clr.ImportExtensions(Revit.GeometryConversion)

# Enable Revit API
clr.AddReference('RevitAPI')
from Autodesk.Revit.DB import *
from Autodesk.Revit.DB.Architecture import *
# Enable DocumentManager and TransactionManager
clr.AddReference('RevitServices')
from RevitServices.Persistence import DocumentManager
from RevitServices.Transactions import TransactionManager

# Enable ICollection List Translate
clr.AddReference("System")
import System.Collections.Generic
from System.Collections.Generic import List
import math
from itertools import compress
from System import Array
from array import array

def normalize(length,nostartend = False,twominonly = False):
	if length != None:
		if length <= 3 and twominonly == False:
			length = 4
		elif length <= 3 and twominonly == True:
			if length < 2:
				length = 2
		if nostartend:
			length += 2
		a = range(0,int(length))
		points = []
		amin, amax = min(a), max(a)
		item = []
		for val in a:
			item.append(float(val-amin) / float(amax-amin))
	else:
		item = [None]
	if nostartend == True:
		item.pop(0)
		item.pop(-1)
	return item

def fixcurve(crv,div):
	nums = normalize(div)
	pts = []
	for n in nums:
		pts.append(dg.Curve.PointAtParameter(crv,n))
	curve = dg.NurbsCurve.ByControlPoints(pts)
	return curve

# Choose The Current Document
doc = DocumentManager.Instance.CurrentDBDocument
uidoc = DocumentManager.Instance.CurrentUIApplication.ActiveUIDocument
uiapp = DocumentManager.Instance.CurrentUIApplication
app = uiapp.Application

lines = UnwrapElement(IN[0])
condi = UnwrapElement(IN[1])

if int(DocumentManager.Instance.CurrentUIApplication.Application.VersionNumber) < 2021:
	unit_type = UnitType.UT_Length
	formatoptions = doc.GetUnits().GetFormatOptions(unit_type)
	dispunits = formatoptions.DisplayUnits
	precision = UnitUtils.ConvertFromInternalUnits(0.5,dispunits)
else:
	precision = UnitUtils.ConvertFromInternalUnits(0.5,doc.GetUnits().GetFormatOptions(SpecTypeId.Length).GetUnitTypeId())

if len(condi) == 1:
	lines = [lines]

allpatched = []
for eachfloor in lines:
	floorpatchedloops = []
	for eachloop in eachfloor:
		joinedloop = dg.PolyCurve.ByJoinedCurves(eachloop)
		try:
			patchedloop = dg.Surface.ByPatch(joinedloop)
		except:
			try:
				exploded = dg.Geometry.Explode(joinedloop)
				newex = []
				for ex in exploded:
					newex.append(fixcurve(ex,ex.Length/precision))
				joinedloop = dg.PolyCurve.ByJoinedCurves(newex)
				patchedloop = dg.Surface.ByPatch(joinedloop)
			except:
				patchedloop = None
		floorpatchedloops.append(patchedloop)
	allpatched.append(floorpatchedloops)

masterstats = []
for eachpatchgroup in allpatched:
	numb = range(len(eachpatchgroup))
	allstats = []
	for eachpatch in eachpatchgroup:
		stats = []
		areas = []
		for s in numb:
			try:
				if dg.Geometry.DoesIntersect(eachpatch,eachpatchgroup[s]) == True and eachpatch != eachpatchgroup[s]:
					areas.append(eachpatch.Area)
					areas.append(eachpatchgroup[s].Area)
					stats.append(eachpatch)
					stats.append(eachpatchgroup[s])
				else:
					areas.append(1)
					stats.append("TOREMOVE")
			except:
				areas.append(1)
				stats.append("TOREMOVE")
		allstats.append([x for _,x in sorted(zip(areas,stats))])
	
	masterstats.append(allstats)

cleanm = [x for x in masterstats if x != []]

# Assign your output to the OUT variable.
OUT = cleanm, allpatched
# ----------------------------------------
code_block_2 = CodeBlock(a=python_script) { a[0]; }
code_block_3 = CodeBlock { false; }
clean = List.Clean(list=code_block_2, preserveIndices=code_block_3)
uniqueItems = List.UniqueItems(list=clean@L3)
lastItem = List.LastItem(list=uniqueItems@@L2)
code_block_4 = CodeBlock { "Autodesk.DesignScript.Geometry.Surface"; }
removeIfNot = List.RemoveIfNot(list=lastItem, type=code_block_4)
code_block_5 = CodeBlock { false; }
al_duplicate_item_indices = Custom[AL.Duplicate Item Indices](VARList=lastItem@L2)  # package Synthesize toolkit; Searches an input list for duplicate entries and lists their index numbers. Couple with Get From List to delete duplicates from a list.
removeItemAtIndex = List.RemoveItemAtIndex(list=uniqueItems@L3, indices=al_duplicate_item_indices.VARDuplicateIndices@L2)
uniqueItems_2 = List.UniqueItems(list=removeItemAtIndex@@L2)
code_block_6 = CodeBlock { null; }
code_block_7 = CodeBlock { "TOREMOVE"; }
eq = _ == code_block_7  # unwired: x
replaceByCondition = Replace(item=uniqueItems_2, replaceWith=code_block_6, condition=eq)
code_block_8 = CodeBlock { -1; }
dropItems = List.DropItems(list=replaceByCondition@@L2, amount=code_block_8)
python_empty_2_null = Custom[Python Empty 2 Null](VARIN=dropItems@L3)  # package Synthesize toolkit; Python Null 2 Empty
isNull = Object.IsNull(object=python_empty_2_null)
allTrue = List.AllTrue(list=isNull@L3)
code_block_9 = CodeBlock(a=python_script) { a[1]; }
flatten = List.Flatten(list=uniqueItems_2)
removeListFromList = Custom[RH.RemoveListFromList](VARListA=code_block_9@L2, VARListB=flatten)  # package Synthesize toolkit; This node essentially "subtracts" the contents of List B from List A to produce a new list with the unique items.
python_empty_2_null_2 = Custom[Python Empty 2 Null](VARIN=removeListFromList)
rank = List.Rank(list=python_empty_2_null_2)
normalizeDepth = List.NormalizeDepth(list=python_empty_2_null_2, rank=rank)
isNull_2 = Object.IsNull(object=normalizeDepth)
filterByBoolMask = List.FilterByBoolMask(list=normalizeDepth, mask=isNull_2)
code_block_10 = CodeBlock { false; }
clean_2 = List.Clean(list=filterByBoolMask.out, preserveIndices=code_block_10)
perimeterCurves = Surface.PerimeterCurves(surface=clean_2)
flatten_2 = List.Flatten(list=perimeterCurves@L2)
VAROffset = Input(VAROffset: var[]..[])
curves_offset_to_revit = Custom[Curves Offset To Revit Compatibility](VARCurves=flatten_2, VAROffset=VAROffset)  # package Synthesize toolkit; Curves Offset To Revit Compatibility
count = List.Count(list=perimeterCurves@L3)
chop = List.Chop(list=curves_offset_to_revit.VARCurves, lengths=count)
flatten_3 = List.Flatten(list=chop@L2)
VARSplineSegmentationDistance = Input(VARSplineSegmentationDistance: var[]..[])
python_script_2 = Python(IN[0]=flatten_3, IN[1]=VARSplineSegmentationDistance)  # IronPython2
# ---------- python_script_2.python (83 lines) ----------
# Created By Karam Baki : karam@aecedx.com
# Enable Python support and load DesignScript library
# IMPORTANT : ALL DYNAMO DESIGN SCRIPT NODES ARE AS (dg)
import clr
clr.AddReference('ProtoGeometry')
from Autodesk.DesignScript import Geometry as dg

# EXTENSION Enable ToDSType
clr.AddReference('RevitNodes')
import Revit
clr.ImportExtensions(Revit.Elements)

def normalize(length,nostartend = False,twominonly = False):
	if length != None:
		if length <= 3 and twominonly == False:
			length = 4
		elif length <= 3 and twominonly == True:
			if length < 2:
				length = 2
		if nostartend:
			length += 2
		a = range(0,int(length))
		points = []
		amin, amax = min(a), max(a)
		item = []
		for val in a:
			item.append(float(val-amin) / float(amax-amin))
	else:
		item = [None]
	if nostartend == True:
		item.pop(0)
		item.pop(-1)
	return item

def fixcurve(crv,div):
	nums = normalize(div)
	pts = []
	for n in nums:
		pts.append(dg.Curve.PointAtParameter(crv,n))
	curve = dg.NurbsCurve.ByControlPoints(pts)
	return curve

def spltocurve(crv,distance):
	try:
		if "NurbsCurve" in crv.ToString() and distance != 0:
			div = int(round(crv.Length/distance))
			arcs = []
			increment = 1.0 / div
			try:
				tan = crv.TangentAtParameter(0)
			except:
				crv = fixcurve(crv,div*10)
				tan = crv.TangentAtParameter(0)
			for j in range(0, div):
				incstart = increment * j
				incend = increment * (j+1)
				ptstart = crv.PointAtParameter(incstart)
				ptend = crv.PointAtParameter(incend)
				try:
					arc = dg.Arc.ByStartPointEndPointStartTangent(ptstart,ptend,tan)
				except:
					arc = dg.Line.ByStartPointEndPoint(ptstart,ptend)
				arcs.append(arc)
				tan = arc.TangentAtParameter(1)
			joined = dg.PolyCurve.ByJoinedCurves(arcs)
			return joined
		else:
			return crv
	except:
		return crv

lists = UnwrapElement(IN[0])
distance = IN[1]

result = []
for l in lists:
	tmp = []
	for c in l:
		tmp.append(spltocurve(c,distance))
	result.append(tmp)

# Assign your output to the OUT variable.
OUT = result
# ----------------------------------------
VAROverrideFloorTypes = Input(VAROverrideFloorTypes: var[]..[])
watch = Watch(chop)
code_block_11 = CodeBlock { "Type"; "Level"; "Height Offset From Level"; }
getParameterValueByName = Element.GetParameterValueByName(element=byClassName.VARin, parameterName=code_block_11.out0)
allTrue_2 = List.AllTrue(list=isNull_2@L2)
filterByBoolMask_2 = List.FilterByBoolMask(list=getParameterValueByName, mask=allTrue_2)
matchLength = Custom[LF.List.MatchLength](VARlistLength=watch, VARlist=filterByBoolMask_2.out)  # package Synthesize toolkit; Cycle a list to match the length of the first list.
flatten_4 = List.Flatten(list=matchLength)
VARFloorType = Input(VARFloorType: var[]..[])
matchLength_2 = Custom[LF.List.MatchLength](VARlistLength=flatten_4, VARlist=VARFloorType)
scopeIf = Custom[CW.ScopeIf+](VARtest=VAROverrideFloorTypes, VARtrue=matchLength_2, VARfalse=flatten_4)  # package Synthesize toolkit; A (hopefully) more robust implementation of ScopeIf. Tests a single boolean and returns a value accordingly.
getParameterValueByName_2 = Element.GetParameterValueByName(element=byClassName.VARin, parameterName=code_block_11.out1)
filterByBoolMask_3 = List.FilterByBoolMask(list=getParameterValueByName_2, mask=allTrue_2)
matchLength_3 = Custom[LF.List.MatchLength](VARlistLength=watch, VARlist=filterByBoolMask_3.out)
flatten_5 = List.Flatten(list=matchLength_3)
byOutlineTypeAndLevel = Floor.ByOutlineTypeAndLevel(outlineCurves=python_script_2, floorType=scopeIf, level=flatten_5, lacing=Longest)
isNull_3 = Object.IsNull(object=byOutlineTypeAndLevel)
filterByBoolMask_4 = List.FilterByBoolMask(list=byOutlineTypeAndLevel, mask=isNull_3)
code_block_12 = CodeBlock { "Height Offset From Level"; }
getParameterValueByName_3 = Element.GetParameterValueByName(element=byClassName.VARin, parameterName=code_block_11.out2)
filterByBoolMask_5 = List.FilterByBoolMask(list=getParameterValueByName_3, mask=allTrue_2)
matchLength_4 = Custom[LF.List.MatchLength](VARlistLength=watch, VARlist=filterByBoolMask_5.out)
flatten_6 = List.Flatten(list=matchLength_4)
filterByBoolMask_6 = List.FilterByBoolMask(list=flatten_6, mask=isNull_3)
setParameterByName = Element.SetParameterByName(element=filterByBoolMask_4.out, parameterName=code_block_12, value=filterByBoolMask_6.out, lacing=Longest)
lastItem_2 = List.LastItem(list=replaceByCondition@@L2)
isNull_4 = Object.IsNull(object=lastItem_2)
filterByBoolMask_7 = List.FilterByBoolMask(list=lastItem_2, mask=isNull_4)
code_block_13 = CodeBlock { false; }
clean_3 = List.Clean(list=filterByBoolMask_7.out, preserveIndices=code_block_13)
perimeterCurves_2 = Surface.PerimeterCurves(surface=clean_3)
flatten_7 = List.Flatten(list=perimeterCurves_2@L2)
curves_offset_to_revit_2 = Custom[Curves Offset To Revit Compatibility](VARCurves=flatten_7, VAROffset=VAROffset)
count_2 = List.Count(list=perimeterCurves_2@L3)
chop_2 = List.Chop(list=curves_offset_to_revit_2.VARCurves, lengths=count_2)
flatten_8 = List.Flatten(list=chop_2@L2)
python_script_3 = Python(IN[0]=flatten_8, IN[1]=VARSplineSegmentationDistance)  # IronPython2; same code as python_script_2
allTrue_3 = List.AllTrue(list=isNull_4@L2)
filterByBoolMask_8 = List.FilterByBoolMask(list=getParameterValueByName, mask=allTrue_3)
matchLength_5 = Custom[LF.List.MatchLength](VARlistLength=chop_2, VARlist=filterByBoolMask_8.out)
flatten_9 = List.Flatten(list=matchLength_5)
matchLength_6 = Custom[LF.List.MatchLength](VARlistLength=flatten_9, VARlist=VARFloorType)
scopeIf_2 = Custom[CW.ScopeIf+](VARtest=VAROverrideFloorTypes, VARtrue=matchLength_6, VARfalse=flatten_9)
filterByBoolMask_9 = List.FilterByBoolMask(list=getParameterValueByName_2, mask=allTrue_3)
matchLength_7 = Custom[LF.List.MatchLength](VARlistLength=chop_2, VARlist=filterByBoolMask_9.out)
flatten_10 = List.Flatten(list=matchLength_7)
byOutlineTypeAndLevel_2 = Floor.ByOutlineTypeAndLevel(outlineCurves=python_script_3, floorType=scopeIf_2, level=flatten_10, lacing=Longest)
isNull_5 = Object.IsNull(object=byOutlineTypeAndLevel_2)
filterByBoolMask_10 = List.FilterByBoolMask(list=byOutlineTypeAndLevel_2, mask=isNull_5)
code_block_14 = CodeBlock { "Height Offset From Level"; }
filterByBoolMask_11 = List.FilterByBoolMask(list=getParameterValueByName_3, mask=allTrue_3)
matchLength_8 = Custom[LF.List.MatchLength](VARlistLength=chop_2, VARlist=filterByBoolMask_11.out)
flatten_11 = List.Flatten(list=matchLength_8)
filterByBoolMask_12 = List.FilterByBoolMask(list=flatten_11, mask=isNull_5)
setParameterByName_2 = Element.SetParameterByName(element=filterByBoolMask_10.out, parameterName=code_block_14, value=filterByBoolMask_12.out, lacing=Longest)
filterByBoolMask_13 = List.FilterByBoolMask(list=byOutlineTypeAndLevel_2, mask=isNull_5)
filterByBoolMask_14 = List.FilterByBoolMask(list=python_empty_2_null, mask=isNull)
code_block_15 = CodeBlock { false; }
clean_4 = List.Clean(list=filterByBoolMask_14.out, preserveIndices=code_block_15)
perimeterCurves_3 = Surface.PerimeterCurves(surface=clean_4)
flatten_12 = List.Flatten(list=perimeterCurves_3@L2)
curves_offset_to_revit_3 = Custom[Curves Offset To Revit Compatibility](VARCurves=flatten_12, VAROffset=VAROffset)
count_3 = List.Count(list=perimeterCurves_3@L3)
chop_3 = List.Chop(list=curves_offset_to_revit_3.VARCurves, lengths=count_3)
count_4 = List.Count(list=perimeterCurves_3@L4)
chop_4 = List.Chop(list=chop_3, lengths=count_4)
byJoinedCurves = PolyCurve.ByJoinedCurves(curves=chop_4)
flatten_13 = List.Flatten(list=byJoinedCurves@L2)
curves = PolyCurve.Curves(polyCurve=flatten_13)
filterByBoolMask_15 = List.FilterByBoolMask(list=curves, mask=isNull_5)
python_script_4 = Python(IN[0]=filterByBoolMask_15.out, IN[1]=VARSplineSegmentationDistance)  # IronPython2
# ---------- python_script_4.python (96 lines) ----------
# Created By Karam Baki : karam@aecedx.com
# Enable Python support and load DesignScript library
# IMPORTANT : ALL DYNAMO DESIGN SCRIPT NODES ARE AS (dg)
import clr
clr.AddReference('ProtoGeometry')
from Autodesk.DesignScript import Geometry as dg

# EXTENSION Enable ToDSType
clr.AddReference('RevitNodes')
import Revit
clr.ImportExtensions(Revit.Elements)

def flatten(x):
    result = []
    for el in x:
        if hasattr(el, "__iter__") and not isinstance(el, basestring):
            result.extend(flatten(el))
        else:
            result.append(el)
    return result

def normalize(length,nostartend = False,twominonly = False):
	if length != None:
		if length <= 3 and twominonly == False:
			length = 4
		elif length <= 3 and twominonly == True:
			if length < 2:
				length = 2
		if nostartend:
			length += 2
		a = range(0,int(length))
		points = []
		amin, amax = min(a), max(a)
		item = []
		for val in a:
			item.append(float(val-amin) / float(amax-amin))
	else:
		item = [None]
	if nostartend == True:
		item.pop(0)
		item.pop(-1)
	return item

def fixcurve(crv,div):
	nums = normalize(div)
	pts = []
	for n in nums:
		pts.append(dg.Curve.PointAtParameter(crv,n))
	curve = dg.NurbsCurve.ByControlPoints(pts)
	return curve

def spltocurve(crv,distance):
	try:
		if distance != 0:
			crv = list(dg.Geometry.Explode(crv))[0]
		if "NurbsCurve" in crv.ToString() and distance != 0:
			div = int(round(crv.Length/distance))
			arcs = []
			increment = 1.0 / div
			try:
				tan = crv.TangentAtParameter(0)
			except:
				crv = fixcurve(crv,div*10)
				tan = crv.TangentAtParameter(0)
			for j in range(0, div):
				incstart = increment * j
				incend = increment * (j+1)
				ptstart = crv.PointAtParameter(incstart)
				ptend = crv.PointAtParameter(incend)
				try:
					arc = dg.Arc.ByStartPointEndPointStartTangent(ptstart,ptend,tan)
				except:
					arc = dg.Line.ByStartPointEndPoint(ptstart,ptend)
				arcs.append(arc)
				tan = arc.TangentAtParameter(1)
			return arcs
		else:
			return crv
	except:
		return crv

lists = UnwrapElement(IN[0])
distance = IN[1]

result = []
for l in lists:
	tmp = []
	for c in l:
		tmp2 = []
		for z in c:
			tmp2.append(spltocurve(z,distance))
		tmp.append(flatten(tmp2))
	result.append(tmp)

# Assign your output to the OUT variable.
OUT = result
# ----------------------------------------
byCurves = Custom[SP.FloorOpening.ByCurves](VARhost=filterByBoolMask_13.out, VARcurves=python_script_4@L3, lacing=Longest)  # package Synthesize toolkit; Create hosted floor opeinngs through the input floors. The second input is a list of sub-lists of the boundary curves.
code_block_16 = CodeBlock { false; }
clean_5 = List.Clean(list=byCurves, preserveIndices=code_block_16)
flatten_14 = List.Flatten(list=clean_5)
VAROpenings = Output(flatten_14)
VARExistedFloors = Output(byClassName.VARin)
create = List.Create(item0=byOutlineTypeAndLevel, item1=byOutlineTypeAndLevel_2)
code_block_17 = CodeBlock { false; }
clean_6 = List.Clean(list=create, preserveIndices=code_block_17)
flatten_15 = List.Flatten(list=clean_6)
VARNewFloors = Output(flatten_15)
create_2 = List.Create(item0=python_script_2, item1=python_script_3, item2=python_script_4)
code_block_18 = CodeBlock { false; }
clean_7 = List.Clean(list=create_2, preserveIndices=code_block_18)
flatten_16 = List.Flatten(list=clean_7)
explode = Geometry.Explode(geometry=flatten_16)
flatten_17 = List.Flatten(list=explode)
VARCurves = Output(flatten_17)
