# Dynamo custom node Force Surface to Planar.dyf (Dynamo 2.1.0.7500)
# category: Synthesize.Automate.Surface
# Force Surface to Planar

VARForceOrNot = Input(VARForceOrNot: bool = true)
VARSurfaces = Input(VARSurfaces: var[]..[])
perimeterCurves = Surface.PerimeterCurves(surface=VARSurfaces)
empty = List.Empty()
scopeIf = Custom[CW.ScopeIf+](VARtest=VARForceOrNot, VARtrue=VARSurfaces, VARfalse=empty)  # A (hopefully) more robust implementation of ScopeIf. Tests a single boolean and returns a value accordingly.
code_block = CodeBlock { 0.5; }
pointAtParameter = Surface.PointAtParameter(surface=scopeIf, v=code_block)
normalAtParameter = Surface.NormalAtParameter(surface=scopeIf, u=code_block, v=code_block)
byOriginNormal = Plane.ByOriginNormal(origin=pointAtParameter, normal=normalAtParameter)
pullOntoPlane = Curve.PullOntoPlane(curve=perimeterCurves, plane=byOriginNormal)
startPoint = Curve.StartPoint(curve=pullOntoPlane)
byPerimeterPoints = Surface.ByPerimeterPoints(points=startPoint)
flatten = List.Flatten(list=byPerimeterPoints)
scopeIf_2 = Custom[CW.ScopeIf+](VARtest=VARForceOrNot, VARtrue=flatten, VARfalse=VARSurfaces)
VARSurfaces_2 = Output(scopeIf_2)  # "VARSurfaces"
perimeterCurves_2 = Surface.PerimeterCurves(surface=flatten)
scopeIf_3 = Custom[CW.ScopeIf+](VARtest=VARForceOrNot, VARtrue=perimeterCurves_2, VARfalse=perimeterCurves)
VARPerimeterCurves = Output(scopeIf_3)
