# Dynamo custom node Generate Intersecting Pairs Sublists.dyf (Dynamo 2.1.0.7500)
# category: Synthesize.Automate.List
# Generate Intersecting Pairs Sublists

VARItems = Input(VARItems: var[]..[])
code_block = CodeBlock { false; }
clean = List.Clean(list=VARItems, preserveIndices=code_block)
geometry = Element.Geometry(element=clean)
isEmpty = List.IsEmpty(list=geometry@L2)
filterByBoolMask = List.FilterByBoolMask(list=VARItems, mask=isEmpty)
count = List.Count(list=filterByBoolMask.out)
VARNumberofItems = Output(count)
flatten = List.Flatten(list=geometry)
doesIntersect = Geometry.DoesIntersect(geometry=flatten@L1, other=flatten)
count_2 = List.Count(list=doesIntersect)
ofRepeatedItem = List.OfRepeatedItem(item=filterByBoolMask.out, amount=count_2)
filterByBoolMask_2 = List.FilterByBoolMask(list=ofRepeatedItem, mask=doesIntersect)
code_block_2 = CodeBlock { 2; }
combinations = List.Combinations(list=filterByBoolMask_2.in@L2, length=code_block_2)
flatten_2 = List.Flatten(list=combinations@L2)
uniqueItems = List.UniqueItems(list=flatten_2)
hot_index_of_item = Custom[HOT.Index of item](VARList=filterByBoolMask_2.in@L2, VARItem=filterByBoolMask.out, lacing=Longest)  # Index of Item on List
removeItemAtIndex = List.RemoveItemAtIndex(list=filterByBoolMask_2.in@L2, indices=hot_index_of_item@L2)
code_block_3 = CodeBlock { 2; false; }
combinations_2 = List.Combinations(list=removeItemAtIndex@L2, length=code_block_3.out0)
clean_2 = List.Clean(list=combinations_2, preserveIndices=code_block_3.out1)
flatten_3 = List.Flatten(list=clean_2@L2)
uniqueItems_2 = List.UniqueItems(list=flatten_3)
contains = List.Contains(list=uniqueItems@L2, item=uniqueItems_2@L1, lacing=CrossProduct)
code_block_4 = CodeBlock { 2; }
chop = List.Chop(list=contains@L2, lengths=code_block_4)
allTrue = List.AllTrue(list=chop@L2)
count_3 = List.Count(list=uniqueItems_2)
chop_2 = List.Chop(list=allTrue, lengths=count_3)
anyTrue = Custom[CW.List.AnyTrue](VARseq=chop_2)  # Returns true if any item in a list of booleans is true.
filterByBoolMask_3 = List.FilterByBoolMask(list=uniqueItems, mask=anyTrue)
VARPairsSublists = Output(filterByBoolMask_3.out)
