# Dynamo custom node Generate Lines by AutoSplit.dyf (Dynamo 2.1.0.7500)
# category: Synthesize.Automate.Lines
# Generate Lines by AutoSplit

VARDeleteOriginal = Input(VARDeleteOriginal: var[]..[])
VARLinestoSplit = Input(VARLinestoSplit: var[]..[])
flatten = List.Flatten(list=VARLinestoSplit)
curves = Element.Curves(element=VARLinestoSplit)
isEmpty = List.IsEmpty(list=curves, lacing=Longest)
filterByBoolMask = List.FilterByBoolMask(list=flatten, mask=isEmpty)
VAR3DSnappingModeConceptualEnvironment = Input(VAR3DSnappingModeConceptualEnvironment: var[]..[])
code_block = CodeBlock { null; }
VARDetailLine = Input(VARDetailLine: var[]..[] = FalseModelLine = True;)
VARCleanUpMode = Input(VARCleanUpMode: var[]..[])
code_block_2 = CodeBlock { null; }
flatten_2 = List.Flatten(list=curves)
join = List.Join()  # unwired: list0, list1
VARSplittingLines = Input(VARSplittingLines: var[]..[])
curves_2 = Element.Curves(element=VARSplittingLines)
flatten_3 = List.Flatten(list=curves_2)
split = Geometry.Split(geometry=flatten_2@L2, other=flatten_3, lacing=Longest)
transpose = List.Transpose(lists=split)
flatten_4 = List.Flatten(list=transpose@L3)
startPoint = Curve.StartPoint(curve=flatten_4)
endPoint = Curve.EndPoint(curve=flatten_4)
combine = List.Combine(comb=join, list1=startPoint, list2=endPoint)
pruneDuplicates = Point.PruneDuplicates(points=combine)
splitByPoints = Curve.SplitByPoints(curve=flatten_2, points=pruneDuplicates)
flatten_5 = List.Flatten(list=splitByPoints)
scopeIf = Custom[CW.ScopeIf+](VARtest=VARCleanUpMode, VARtrue=code_block_2, VARfalse=flatten_5)  # A (hopefully) more robust implementation of ScopeIf. Tests a single boolean and returns a value accordingly.
VARTakesInside = Input(VARTakesInside: var[]..[] = FalseTakesOutside = TrueWorksOnlyifCleanUpison;)
code_block_3 = CodeBlock { null; false; }
scopeIf_2 = Custom[CW.ScopeIf+](VARtest=VARCleanUpMode, VARtrue=flatten_5, VARfalse=code_block_3.out0)
clean = List.Clean(list=scopeIf_2, preserveIndices=code_block_3.out1)
as_polycurve_bycurves = Custom[AS.[&] PolyCurve.ByCurves](VARcurves=flatten_3)  # Create polycurves from an unordered list of curves.
isClosed = Curve.IsClosed(curve=as_polycurve_bycurves.VARpolyCurve)
filterByBoolMask_2 = List.FilterByBoolMask(list=as_polycurve_bycurves.VARpolyCurve, mask=isClosed)
scopeIf_3 = Custom[CW.ScopeIf+](VARtest=VARCleanUpMode, VARtrue=filterByBoolMask_2.in, VARfalse=code_block_3.out0)
byPatch = Surface.ByPatch()  # unwired: closedCurve
map = List.Map(list=scopeIf_3, f_x=byPatch)
count = List.Count(list=map)
cycle = List.Cycle(list=clean, amount=count)
code_block_4 = CodeBlock { 0..1..0.25; }
pointAtParameter = Curve.PointAtParameter(curve=clean, param=code_block_4@L1)
transpose_2 = List.Transpose(lists=pointAtParameter)
dropFirstLast = Custom[SP.List.DropFirstLast](VARlist=transpose_2@L2)  # Removes the first and last items from the list
doesIntersect = Geometry.DoesIntersect(geometry=dropFirstLast.VARlist, other=map@L1)
allTrue = List.AllTrue(list=doesIntersect@L2)
filterByBoolMask_3 = List.FilterByBoolMask(list=cycle, mask=allTrue)
flatten_6 = List.Flatten(list=filterByBoolMask_3.out)
removeListFromList = Custom[RH.RemoveListFromList](VARListA=flatten_6, VARListB=filterByBoolMask_3.in)  # This node essentially "subtracts" the contents of List B from List A to produce a new list with the unique items.
code_block_5 = CodeBlock { null; false; }
scopeIf_4 = Custom[CW.ScopeIf+](VARtest=VARTakesInside, VARtrue=removeListFromList, VARfalse=code_block_5.out0)
flatten_7 = List.Flatten(list=filterByBoolMask_3.in)
scopeIf_5 = Custom[CW.ScopeIf+](VARtest=VARTakesInside, VARtrue=code_block_5.out0, VARfalse=flatten_7)
create = List.Create(item0=scopeIf_4, item1=scopeIf_5)
clean_2 = List.Clean(list=create, preserveIndices=code_block_5.out1)
flatten_8 = List.Flatten(list=clean_2)
create_2 = List.Create(item0=scopeIf, item1=flatten_8)
code_block_6 = CodeBlock { false; }
clean_3 = List.Clean(list=create_2, preserveIndices=code_block_6)
flatten_9 = List.Flatten(list=clean_3)
isEmpty_2 = List.IsEmpty(list=flatten_9)
code_block_7 = CodeBlock { null; false; }
scopeIf_6 = Custom[CW.ScopeIf+](VARtest=isEmpty_2, VARtrue=flatten_5, VARfalse=code_block_7.out0)
scopeIf_7 = Custom[CW.ScopeIf+](VARtest=isEmpty_2, VARtrue=code_block_7.out0, VARfalse=flatten_9)
create_3 = List.Create(item0=scopeIf_6, item1=scopeIf_7)
clean_4 = List.Clean(list=create_3, preserveIndices=code_block_7.out1)
flatten_10 = List.Flatten(list=clean_4)
code_block_8 = CodeBlock { null; false; }
scopeIf_8 = Custom[CW.ScopeIf+](VARtest=VARDetailLine, VARtrue=flatten_10, VARfalse=code_block_8.out0)
scopeIf_9 = Custom[CW.ScopeIf+](VARtest=VAR3DSnappingModeConceptualEnvironment, VARtrue=code_block, VARfalse=scopeIf_8)
clean_5 = List.Clean(list=scopeIf_9, preserveIndices=code_block_8.out1)
byCurve = ModelCurve.ByCurve(curve=clean_5)
scopeIf_10 = Custom[CW.ScopeIf+](VARtest=VARDetailLine, VARtrue=code_block_8.out0, VARfalse=flatten_10)
scopeIf_11 = Custom[CW.ScopeIf+](VARtest=VAR3DSnappingModeConceptualEnvironment, VARtrue=code_block, VARfalse=scopeIf_10)
clean_6 = List.Clean(list=scopeIf_11, preserveIndices=code_block_8.out1)
hot_get_revit_activeview = Custom[HOT.Get Revit ActiveView]()  # Active View
fromCurve = Custom[CW.DetailLine.FromCurve](VARcurve=clean_6, VARview=hot_get_revit_activeview)  # Creates a detail line based on a given curve
isNull = Object.IsNull(obj=byCurve)
filterByBoolMask_4 = List.FilterByBoolMask(list=clean_5, mask=isNull)
code_block_9 = CodeBlock { false; }
clean_7 = List.Clean(list=filterByBoolMask_4.in, preserveIndices=code_block_9)
flatten_11 = List.Flatten(list=clean_7)
toNurbsCurve = Curve.ToNurbsCurve(curve=flatten_11)
controlPoints = NurbsCurve.ControlPoints(nurbsCurve=toNurbsCurve)
byControlPoints = NurbsCurve.ByControlPoints(points=controlPoints)
filterByBoolMask_5 = List.FilterByBoolMask(list=byControlPoints, mask=isNull)
code_block_10 = CodeBlock { false; }
clean_8 = List.Clean(list=filterByBoolMask_5.in, preserveIndices=code_block_10)
flatten_12 = List.Flatten(list=clean_8)
byCurve_2 = ModelCurve.ByCurve(curve=flatten_12)
isNull_2 = Object.IsNull(obj=fromCurve)
filterByBoolMask_6 = List.FilterByBoolMask(list=clean_6, mask=isNull_2)
code_block_11 = CodeBlock { false; }
clean_9 = List.Clean(list=filterByBoolMask_6.in, preserveIndices=code_block_11)
flatten_13 = List.Flatten(list=clean_9)
toNurbsCurve_2 = Curve.ToNurbsCurve(curve=flatten_13)
controlPoints_2 = NurbsCurve.ControlPoints(nurbsCurve=toNurbsCurve_2)
byControlPoints_2 = NurbsCurve.ByControlPoints(points=controlPoints_2)
filterByBoolMask_7 = List.FilterByBoolMask(list=byControlPoints_2, mask=isNull_2)
code_block_12 = CodeBlock { false; }
clean_10 = List.Clean(list=filterByBoolMask_7.in, preserveIndices=code_block_12)
flatten_14 = List.Flatten(list=clean_10)
fromCurve_2 = Custom[CW.DetailLine.FromCurve](VARcurve=flatten_14, VARview=hot_get_revit_activeview)
create_4 = List.Create(item0=byCurve, item1=fromCurve, item2=byCurve_2, item3=fromCurve_2)
code_block_13 = CodeBlock { false; }
clean_11 = List.Clean(list=create_4, preserveIndices=code_block_13)
flatten_15 = List.Flatten(list=clean_11)
passthrough = Custom[CW.Passthrough](VARpassThrough=filterByBoolMask.out, VARwaitFor=flatten_15)  # Forces a sequential order of execution. The node wired into the output of the Passthrough node will be executed *after* the node wired into the waitFor input (e.g. important for some Revit operations). The value of the passThrough input will be passed on to the node wired into the output port of the Passthrough node.
code_block_14 = CodeBlock { null; false; }
scopeIf_12 = Custom[CW.ScopeIf+](VARtest=VARDeleteOriginal, VARtrue=passthrough, VARfalse=code_block_14.out0)
clean_12 = List.Clean(list=scopeIf_12, preserveIndices=code_block_14.out1)
eraser = Custom[ST.Tool.Eraser](VARList=clean_12)  # Try to delete any element from project
VARCantdeleteIds = Output(eraser)
create_5 = List.Create(item0=scopeIf_8, item1=scopeIf_10)
code_block_15 = CodeBlock { false; }
clean_13 = List.Clean(list=create_5, preserveIndices=code_block_15)
flatten_16 = List.Flatten(list=clean_13)
scopeIf_13 = Custom[CW.ScopeIf+](VARtest=VAR3DSnappingModeConceptualEnvironment, VARtrue=flatten_16, VARfalse=code_block)
code_block_16 = CodeBlock { 0; 1; }
VARNumberofControlPoints3DSnappingMode = Input(VARNumberofControlPoints3DSnappingMode: var[]..[])
sequence = Sequence(start=code_block_16.out0, amount=VARNumberofControlPoints3DSnappingMode, step=code_block_16.out1, lacing=Longest)
remapRange = Math.RemapRange(numbers=sequence, newMin=code_block_16.out0, newMax=code_block_16.out1)
pointAtParameter_2 = Curve.PointAtParameter(curve=scopeIf_13@L1, param=remapRange)
byPoint = ReferencePoint.ByPoint(pt=pointAtParameter_2@L2)
byReferencePoints = CurveByPoints.ByReferencePoints(points=byPoint)
create_6 = List.Create(item0=byReferencePoints, item1=flatten_15)
code_block_17 = CodeBlock { false; }
clean_14 = List.Clean(list=create_6, preserveIndices=code_block_17)
flatten_17 = List.Flatten(list=clean_14)
VARElements = Output(flatten_17)
code_block_18 = CodeBlock { "Is Reference Line"; }
VARIsReference = Input(VARIsReference: var[]..[])
setParameterByName = Element.SetParameterByName(element=byReferencePoints, parameterName=code_block_18, value=VARIsReference)
VARReferencePoints = Output(byPoint)
