# Dynamo custom node Generate Lines.dyf (Dynamo 2.1.0.7500)
# category: Synthesize.Automate.Lines
# Generate Lines

VARLinesWithPoints = Input(VARLinesWithPoints: var[]..[])
VARCurves = Input(VARCurves: var[]..[])
flatten = List.Flatten(list=VARCurves)
as_polycurve_bycurves = Custom[AS.[&] PolyCurve.ByCurves](VARcurves=flatten)  # Create polycurves from an unordered list of curves.
flatten_2 = List.Flatten(list=as_polycurve_bycurves.VARpolyCurve)
code_block = CodeBlock { 1; 0; }
VARNumberofControlPointsPerLine = Input(VARNumberofControlPointsPerLine: var[]..[])
sequence = Sequence(start=code_block.out0, amount=VARNumberofControlPointsPerLine, step=code_block.out0, lacing=Longest)
remapRange = Math.RemapRange(numbers=sequence, newMin=code_block.out1, newMax=code_block.out0)
pointAtParameter = Curve.PointAtParameter(curve=flatten_2@L1, param=remapRange)
pruneDuplicates = Point.PruneDuplicates(points=pointAtParameter)
byPoints = NurbsCurve.ByPoints(points=pruneDuplicates)
VARExtraExtendedDistance = Input(VARExtraExtendedDistance: var[]..[])
extendStart = Curve.ExtendStart(curve=byPoints, distance=VARExtraExtendedDistance)
extendEnd = Curve.ExtendEnd(curve=extendStart, distance=VARExtraExtendedDistance)
code_block_2 = CodeBlock { false; }
clean = List.Clean(list=extendEnd, preserveIndices=code_block_2)
flatten_3 = List.Flatten(list=clean)
pointAtParameter_2 = Curve.PointAtParameter(curve=flatten_3@L1, param=remapRange)
pruneDuplicates_2 = Point.PruneDuplicates(points=pointAtParameter_2)
code_block_3 = CodeBlock { null; }
scopeIf = Custom[CW.ScopeIf+](VARtest=VARLinesWithPoints, VARtrue=pruneDuplicates_2, VARfalse=code_block_3)  # A (hopefully) more robust implementation of ScopeIf. Tests a single boolean and returns a value accordingly.
code_block_4 = CodeBlock { null; false; }
clean_2 = List.Clean(list=scopeIf, preserveIndices=code_block_4.out1)
byPoint = ReferencePoint.ByPoint(pt=clean_2)
code_block_5 = CodeBlock { false; }
byReferencePoints = CurveByPoints.ByReferencePoints(points=byPoint, isReferenceLine=code_block_5, lacing=Longest)
scopeIf_2 = Custom[CW.ScopeIf+](VARtest=VARLinesWithPoints, VARtrue=code_block_3, VARfalse=pruneDuplicates_2)
clean_3 = List.Clean(list=scopeIf_2, preserveIndices=code_block_4.out1)
byPoints_2 = NurbsCurve.ByPoints(points=clean_3)
byCurve = ModelCurve.ByCurve(curve=byPoints_2)
create = List.Create(item0=byReferencePoints, item1=byCurve)
clean_4 = List.Clean(list=create, preserveIndices=code_block_4.out1)
flatten_4 = List.Flatten(list=clean_4)
VARModelCurve = Output(flatten_4)
VARReferencePoints = Output(byPoint)
