# Dynamo custom node Generate Model or Detail Lines.dyf (Dynamo 2.1.0.7500)
# category: Synthesize.Automate.Lines
# Generate Scaled Lines

code_block = CodeBlock { null; false; }
VARDetailLines = Input(VARDetailLines: var[]..[] = FalseModelLines = True;)
code_block_2 = CodeBlock { null; }
VARCurves = Input(VARCurves: var[]..[])
flatten = List.Flatten(list=VARCurves)
code_block_3 = CodeBlock { null; }
scopeIf = Custom[CW.ScopeIf+](VARtest=VARDetailLines, VARtrue=flatten, VARfalse=code_block_3)  # A (hopefully) more robust implementation of ScopeIf. Tests a single boolean and returns a value accordingly.
create = List.Create(item0=scopeIf)
byCurve = ModelCurve.ByCurve()  # unwired: curve
map = List.Map(list=create, f_x=byCurve)
scopeIf_2 = Custom[CW.ScopeIf+](VARtest=VARDetailLines, VARtrue=code_block_3, VARfalse=flatten)
hot_get_revit_activeview = Custom[HOT.Get Revit ActiveView]()  # Active View
fromCurve = Custom[CW.DetailLine.FromCurve](VARcurve=scopeIf_2, VARview=hot_get_revit_activeview)  # Creates a detail line based on a given curve
scopeIf_3 = Custom[CW.ScopeIf+](VARtest=VARDetailLines, VARtrue=map, VARfalse=fromCurve)
flatten_2 = List.Flatten(list=scopeIf_3)
isNull = Object.IsNull(obj=flatten_2)
filterByBoolMask = List.FilterByBoolMask(list=flatten, mask=isNull)
as_polycurve_bycurves = Custom[AS.[&] PolyCurve.ByCurves](VARcurves=filterByBoolMask.in@L1)  # Create polycurves from an unordered list of curves.
flatten_3 = List.Flatten(list=as_polycurve_bycurves.VARpolyCurve)
code_block_4 = CodeBlock { false; }
clean = List.Clean(list=flatten_3, preserveIndices=code_block_4)
curves = PolyCurve.Curves(polyCurve=clean)
code_block_5 = CodeBlock { 0; 1; }
VARNumberofControlPointsofForcedtoNurbsC = Input(VARNumberofControlPointsofForcedtoNurbsCurves: var[]..[])
sequence = Sequence(start=code_block_5.out0, amount=VARNumberofControlPointsofForcedtoNurbsC, step=code_block_5.out1, lacing=Longest)
remapRange = Math.RemapRange(numbers=sequence, newMin=code_block_5.out0, newMax=code_block_5.out1)
count = List.Count(list=curves@L2)
ofRepeatedItem = List.OfRepeatedItem(item=remapRange, amount=count)
pointAtParameter = Curve.PointAtParameter(curve=curves@L2, param=ofRepeatedItem, lacing=Longest)
code_block_6 = CodeBlock { 3; }
byPoints = NurbsCurve.ByPoints(degree=code_block_6)  # unwired: points
map_2 = List.Map(list=pointAtParameter, f_x=byPoints)
flatten_4 = List.Flatten(list=map_2)
scopeIf_4 = Custom[CW.ScopeIf+](VARtest=VARDetailLines, VARtrue=code_block_2, VARfalse=flatten_4)
fromCurve_2 = Custom[CW.DetailLine.FromCurve](VARcurve=scopeIf_4, VARview=hot_get_revit_activeview)
scopeIf_5 = Custom[CW.ScopeIf+](VARtest=VARDetailLines, VARtrue=flatten_4, VARfalse=code_block_2)
byCurve_2 = ModelCurve.ByCurve()  # unwired: curve
map_3 = List.Map(list=scopeIf_5, f_x=byCurve_2)
create_2 = List.Create(item0=fromCurve_2, item1=map_3, item2=fromCurve, item3=map)
code_block_7 = CodeBlock { false; }
clean_2 = List.Clean(list=create_2, preserveIndices=code_block_7)
flatten_5 = List.Flatten(list=clean_2)
VARElements = Output(flatten_5)
create_3 = List.Create(item0=fromCurve_2, item1=map_3)
code_block_8 = CodeBlock { false; }
clean_3 = List.Clean(list=create_3, preserveIndices=code_block_8)
flatten_6 = List.Flatten(list=clean_3)
count_2 = List.Count(list=flatten_6)
VARNumberofLinesForcedtoBeNurbs = Output(count_2)
