# Dynamo custom node Generate Offset or Fillet Lines.dyf (Dynamo 2.1.0.7500)
# category: Synthesize.Automate.Lines
# Generate Offset or Fillet Lines

VARDetailLines = Input(VARDetailLines: var[]..[] = FalseModelLines)
empty = List.Empty()
VAR1Fillet2ArcChamfe3Chamfer = Input(VAR1Fillet2ArcChamfe3Chamfer: var[]..[])
code_block = CodeBlock { 1; 2; 3; }
eq = VAR1Fillet2ArcChamfe3Chamfer == code_block.out0
VARPolyCurves = Input(VARPolyCurves: var[]..[])
turnIntoList = Custom[CW.TurnIntoList](VARunknownItem=VARPolyCurves)  # Turns an element (or a nested list) into a flat list
flatten = List.Flatten(list=turnIntoList)
code_block_2 = CodeBlock { false; }
clean = List.Clean(list=flatten, preserveIndices=code_block_2)
as_polycurve_bycurves = Custom[AS.[&] PolyCurve.ByCurves](VARcurves=clean)  # Create polycurves from an unordered list of curves.
empty_2 = List.Empty()
scopeIf = Custom[CW.ScopeIf+](VARtest=eq, VARtrue=as_polycurve_bycurves.VARpolyCurve, VARfalse=empty_2)  # A (hopefully) more robust implementation of ScopeIf. Tests a single boolean and returns a value accordingly.
VARRadiusorChamfer = Input(VARRadiusorChamfer: var[]..[])
fillet = Custom[SP.PolyCurve.Fillet+](polycurve=scopeIf, radius=VARRadiusorChamfer)  # Fillet a polycurve in its plane. Unlike the built in node, this works in both in the CW and the CCW direction.
eq_2 = VAR1Fillet2ArcChamfe3Chamfer == code_block.out1
scopeIf_2 = Custom[CW.ScopeIf+](VARtest=eq_2, VARtrue=as_polycurve_bycurves.VARpolyCurve, VARfalse=empty_2)
VARFlipForArcChamferMode = Input(VARFlipForArcChamferMode: var[]..[])
arcChamfer = Custom[SP.PolyCurve.ArcChamfer](polycurve=scopeIf_2, distance=VARRadiusorChamfer, flip=VARFlipForArcChamferMode)  # Symmetrically chamfers the corners of the polycurve by the designated distance and close with tangent arcs.
eq_3 = VAR1Fillet2ArcChamfe3Chamfer == code_block.out2
scopeIf_3 = Custom[CW.ScopeIf+](VARtest=eq_3, VARtrue=as_polycurve_bycurves.VARpolyCurve, VARfalse=empty_2)
chamfer = Custom[SP.PolyCurve.Chamfer](polycurve=scopeIf_3, distance=VARRadiusorChamfer)  # Symmetrically chamfers the corners of the polycurve by the designated distance
create = List.Create(item0=fillet, item1=arcChamfer, item2=chamfer)
code_block_3 = CodeBlock { false; }
clean_2 = List.Clean(list=create, preserveIndices=code_block_3)
flatten_2 = List.Flatten(list=clean_2)
curves = PolyCurve.Curves(polyCurve=flatten_2)
VAROffsetDistance = Input(VAROffsetDistance: var[]..[])
curves_offset_to_revit = Custom[Curves Offset To Revit Compatibility](VARCurves=curves, VAROffset=VAROffsetDistance)  # Curves Offset To Revit Compatibility
turnIntoList_2 = Custom[CW.TurnIntoList](VARunknownItem=curves_offset_to_revit.VARCurves)
code_block_4 = CodeBlock { false; }
clean_3 = List.Clean(list=turnIntoList_2, preserveIndices=code_block_4)
flatten_3 = List.Flatten(list=clean_3)
scopeIf_4 = Custom[CW.ScopeIf+](VARtest=VARDetailLines, VARtrue=empty, VARfalse=flatten_3)
hot_get_revit_activeview = Custom[HOT.Get Revit ActiveView]()  # Active View
fromCurve = Custom[CW.DetailLine.FromCurve](VARcurve=scopeIf_4, VARview=hot_get_revit_activeview)  # Creates a detail line based on a given curve
scopeIf_5 = Custom[CW.ScopeIf+](VARtest=VARDetailLines, VARtrue=flatten_3, VARfalse=empty)
byCurve = ModelCurve.ByCurve(curve=scopeIf_5)
create_2 = List.Create(item0=fromCurve, item1=byCurve)
code_block_5 = CodeBlock { false; }
clean_4 = List.Clean(list=create_2, preserveIndices=code_block_5)
flatten_4 = List.Flatten(list=clean_4)
VARElements = Output(flatten_4)
