# Dynamo custom node Generate Outlines By Surface Selection.dyf (Dynamo 2.1.0.7500)
# category: Synthesize.Automate.Lines
# Generate Outlines By Surface Selection

VARPullOntoSelectedLevel = Input(VARPullOntoSelectedLevel: var[]..[])
VARSurfaces = Input(VARSurfaces: var[]..[])
turnIntoList = Custom[CW.TurnIntoList](VARunknownItem=VARSurfaces)  # Turns an element (or a nested list) into a flat list
flatten = List.Flatten(list=turnIntoList)
perimeterCurves = Surface.PerimeterCurves(surface=flatten)
VARLevel = Input(VARLevel: var[]..[])
plane = Custom[CW.Level.Plane](VARlevel=VARLevel)  # Retrieves the plane of a given level
matchLength = Custom[LF.List.MatchLength](VARlistLength=perimeterCurves, VARlist=plane)  # Cycle a list to match the length of the first list.
pullOntoPlane = Curve.PullOntoPlane(curve=perimeterCurves, plane=matchLength, lacing=Longest)
scopeIf = Custom[CW.ScopeIf+](VARtest=VARPullOntoSelectedLevel, VARtrue=pullOntoPlane, VARfalse=perimeterCurves)  # A (hopefully) more robust implementation of ScopeIf. Tests a single boolean and returns a value accordingly.
as_polycurve_bycurves = Custom[AS.[&] PolyCurve.ByCurves](VARcurves=scopeIf)  # Create polycurves from an unordered list of curves.
flatten_2 = List.Flatten(list=as_polycurve_bycurves.VARpolyCurve)
curves = PolyCurve.Curves(polyCurve=flatten_2)
VAROffset = Input(VAROffset: var[]..[])
curves_offset_to_revit = Custom[Curves Offset To Revit Compatibility](VARCurves=curves, VAROffset=VAROffset)  # Curves Offset To Revit Compatibility
byCurve = ModelCurve.ByCurve(curve=curves_offset_to_revit.VARCurves)
VARModelLines = Output(byCurve)
