# Dynamo custom node Generate Scaled Lines.dyf (Dynamo 2.1.0.7500)
# category: Synthesize.Automate.Lines
# Generate Scaled Lines

VARDetailLines = Input(VARDetailLines: var[]..[] = FalseModelLines = True;)
code_block = CodeBlock { null; }
VARCADFileLinestoScale = Input(VARCADFileLinestoScale: var[]..[])
curves = Element.Curves(element=VARCADFileLinestoScale)
VARNewX = Input(VARNewX: var[]..[])
VAROldX = Input(VAROldX: var[]..[])
div = VARNewX / VAROldX
VARNewY = Input(VARNewY: var[]..[])
VAROldY = Input(VAROldY: var[]..[])
div_2 = VARNewY / VAROldY
VARNewZ = Input(VARNewZ: var[]..[])
VAROldZ = Input(VAROldZ: var[]..[])
div_3 = VARNewZ / VAROldZ
scale = Geometry.Scale(geometry=curves, xamount=div, yamount=div_2, zamount=div_3)
flatten = List.Flatten(list=scale)
code_block_2 = CodeBlock { null; }
scopeIf = Custom[CW.ScopeIf+](VARtest=VARDetailLines, VARtrue=flatten, VARfalse=code_block_2)  # A (hopefully) more robust implementation of ScopeIf. Tests a single boolean and returns a value accordingly.
create = List.Create(item0=scopeIf)
byCurve = ModelCurve.ByCurve()  # unwired: curve
map = List.Map(list=create, f_x=byCurve)
scopeIf_2 = Custom[CW.ScopeIf+](VARtest=VARDetailLines, VARtrue=code_block_2, VARfalse=flatten)
hot_get_revit_activeview = Custom[HOT.Get Revit ActiveView]()  # Active View
fromCurve = Custom[CW.DetailLine.FromCurve](VARcurve=scopeIf_2, VARview=hot_get_revit_activeview)  # Creates a detail line based on a given curve
scopeIf_3 = Custom[CW.ScopeIf+](VARtest=VARDetailLines, VARtrue=map, VARfalse=fromCurve)
flatten_2 = List.Flatten(list=scopeIf_3)
isNull = Object.IsNull(obj=flatten_2)
filterByBoolMask = List.FilterByBoolMask(list=flatten, mask=isNull)
as_polycurve_bycurves = Custom[AS.[&] PolyCurve.ByCurves](VARcurves=filterByBoolMask.in@L1)  # Create polycurves from an unordered list of curves.
flatten_3 = List.Flatten(list=as_polycurve_bycurves.VARpolyCurve)
code_block_3 = CodeBlock { false; }
clean = List.Clean(list=flatten_3, preserveIndices=code_block_3)
curves_2 = PolyCurve.Curves(polyCurve=clean)
code_block_4 = CodeBlock { 0; 1; }
VARNumberofControlPointsofForcedtoNurbsC = Input(VARNumberofControlPointsofForcedtoNurbsCurves: var[]..[])
sequence = Sequence(start=code_block_4.out0, amount=VARNumberofControlPointsofForcedtoNurbsC, step=code_block_4.out1, lacing=Longest)
remapRange = Math.RemapRange(numbers=sequence, newMin=code_block_4.out0, newMax=code_block_4.out1)
count = List.Count(list=curves_2@L2)
ofRepeatedItem = List.OfRepeatedItem(item=remapRange, amount=count)
pointAtParameter = Curve.PointAtParameter(curve=curves_2@L2, param=ofRepeatedItem, lacing=Longest)
code_block_5 = CodeBlock { 3; }
byPoints = NurbsCurve.ByPoints(degree=code_block_5)  # unwired: points
map_2 = List.Map(list=pointAtParameter, f_x=byPoints)
flatten_4 = List.Flatten(list=map_2)
scopeIf_4 = Custom[CW.ScopeIf+](VARtest=VARDetailLines, VARtrue=code_block, VARfalse=flatten_4)
fromCurve_2 = Custom[CW.DetailLine.FromCurve](VARcurve=scopeIf_4, VARview=hot_get_revit_activeview)
scopeIf_5 = Custom[CW.ScopeIf+](VARtest=VARDetailLines, VARtrue=flatten_4, VARfalse=code_block)
byCurve_2 = ModelCurve.ByCurve()  # unwired: curve
map_3 = List.Map(list=scopeIf_5, f_x=byCurve_2)
create_2 = List.Create(item0=fromCurve_2, item1=map_3, item2=fromCurve, item3=map)
code_block_6 = CodeBlock { false; }
clean_2 = List.Clean(list=create_2, preserveIndices=code_block_6)
flatten_5 = List.Flatten(list=clean_2)
VARElements = Output(flatten_5)
VARDeleteOld = Input(VARDeleteOld: var[]..[])
flatten_6 = List.Flatten(list=VARCADFileLinestoScale)
isEmpty = List.IsEmpty(list=curves, lacing=Longest)
filterByBoolMask_2 = List.FilterByBoolMask(list=flatten_6, mask=isEmpty)
code_block_7 = CodeBlock { null; false; }
scopeIf_6 = Custom[CW.ScopeIf+](VARtest=VARDeleteOld, VARtrue=filterByBoolMask_2.out, VARfalse=code_block_7.out0)
clean_3 = List.Clean(list=scopeIf_6, preserveIndices=code_block_7.out1)
create_3 = List.Create(item0=fromCurve, item1=map)
code_block_8 = CodeBlock { false; }
clean_4 = List.Clean(list=create_3, preserveIndices=code_block_8)
flatten_7 = List.Flatten(list=clean_4)
passthrough = Custom[CW.Passthrough](VARpassThrough=clean_3, VARwaitFor=flatten_7)  # Forces a sequential order of execution. The node wired into the output of the Passthrough node will be executed *after* the node wired into the waitFor input (e.g. important for some Revit operations). The value of the passThrough input will be passed on to the node wired into the output port of the Passthrough node.
eraser = Custom[ST.Tool.Eraser](VARList=passthrough)  # Try to delete any element from project
VARCantdeleteIds = Output(eraser)
create_4 = List.Create(item0=fromCurve_2, item1=map_3)
code_block_9 = CodeBlock { false; }
clean_5 = List.Clean(list=create_4, preserveIndices=code_block_9)
flatten_8 = List.Flatten(list=clean_5)
count_2 = List.Count(list=flatten_8)
VARNumberofLinesForcedtoBeNurbs = Output(count_2)
