# Dynamo custom node Geometry and Vector of Model Curves and Curve By Points With Helping Surfaces.dyf (Dynamo 2.1.0.7500)
# category: Synthesize.Automate.Geometry
# Geometry and Vector of Model Curves and Curve By Points

VARElements = Input(VARElements: var[]..[])
code_block = CodeBlock { "ModelCurve"; "CurveByPoints"; "Elements.AdaptiveComponent"; }
byClassName = Custom[SP.Filter.ByClassName](VARobject=VARElements, VARclassName=code_block.out0)  # Filters a list of objects by the object's class name. Note that Dynamo elements belong to different classes than their Revit counterparts. Use the Object.Class node to check an object's class.
curves = Element.Curves(element=byClassName.VARin)
byClassName_2 = Custom[SP.Filter.ByClassName](VARobject=byClassName.VARout, VARclassName=code_block.out1)
helix_to_curves = Custom[Helix to Curves](VARHelixElements=byClassName_2.VARin)  # Helix to Curves
code_block_2 = CodeBlock { true; }
vector_of_curve_by_points = Custom[Vector of Curve By Points](VARCurveByPoints=byClassName_2.VARin, VARCurveGeometry=helix_to_curves, VARHelpingSurfs=code_block_2)  # Vector of Curve By Points
isNull = Object.IsNull(obj=vector_of_curve_by_points)
filterByBoolMask = List.FilterByBoolMask(list=helix_to_curves, mask=isNull)
byClassName_3 = Custom[SP.Filter.ByClassName](VARobject=byClassName_2.VARout, VARclassName=code_block.out2)
curves_2 = Element.Curves(element=byClassName_3.VARin)
create = List.Create(item0=filterByBoolMask.in, item1=curves_2)
code_block_3 = CodeBlock { false; }
clean = List.Clean(list=create, preserveIndices=code_block_3)
flatten = List.Flatten(list=clean)
code_block_4 = CodeBlock { 1; }
chop = List.Chop(list=flatten, lengths=code_block_4)
flatten_2 = List.Flatten(list=chop)
create_2 = List.Create(item0=curves, item1=filterByBoolMask.out, item2=flatten_2)
code_block_5 = CodeBlock { false; }
clean_2 = List.Clean(list=create_2, preserveIndices=code_block_5)
flatten_3 = List.Flatten(list=clean_2)
VARCurves = Output(flatten_3)
vector_of_model_curve = Custom[Vector of Model Curve](VARModelCurves=byClassName.VARin)  # Vector of Model Curve
filterByBoolMask_2 = List.FilterByBoolMask(list=vector_of_curve_by_points, mask=isNull)
startPoint = Curve.StartPoint(curve=chop)
endPoint = Curve.EndPoint(curve=chop)
create_3 = List.Create(item0=startPoint, item1=endPoint)
transpose = List.Transpose(lists=create_3)
flatten_4 = List.Flatten(list=transpose@L3)
byBestFitThroughPoints = Plane.ByBestFitThroughPoints(points=flatten_4)
normal = Plane.Normal(plane=byBestFitThroughPoints)
VARSurfaces = Input(VARSurfaces: var[]..[])
flatten_5 = List.Flatten(list=VARSurfaces)
python_script = Python(IN[0]=normal, IN[1]=chop, IN[2]=flatten_5)
# ---------- python_script.python (64 lines) ----------
# Enable Python support and load DesignScript library
# IMPORTANT : ALL DYNAMO DESIGN SCRIPT NODES ARE AS (dg)
import clr
clr.AddReference('ProtoGeometry')
from Autodesk.DesignScript import Geometry as dg

# EXTENSION Enable ToDSType
clr.AddReference('RevitNodes')
import Revit
clr.ImportExtensions(Revit.Elements)

# Enable Revit Elements
from Revit.Elements import *

# EXTENSION Enable Geometry Conversion Methods
clr.ImportExtensions(Revit.GeometryConversion)

# Enable Revit API
clr.AddReference('RevitAPI')
from Autodesk.Revit.DB import *

# Enable DocumentManager and TransactionManager
clr.AddReference('RevitServices')
from RevitServices.Persistence import DocumentManager
from RevitServices.Transactions import TransactionManager

# Enable ICollection List Translate
clr.AddReference("System")
import System.Collections.Generic
from System.Collections.Generic import List

dataEnteringNode = IN
# Use UnwrapElement(IN[0]) When Translating From Dynamo to Revit
vectors=UnwrapElement(IN[0])
curves=UnwrapElement(IN[1])
surfaces=UnwrapElement(IN[2])
# Choose The Current Document
doc = DocumentManager.Instance.CurrentDBDocument
uidoc = DocumentManager.Instance.CurrentUIApplication.ActiveUIDocument
uiapp = DocumentManager.Instance.CurrentUIApplication
app = uiapp.Application

# Create Empty List
result = []

count = 0
for v in vectors:
	curve = curves[count][0]
	count += 1
	if v == None:
		distances = []
		point = dg.Curve.PointAtParameter(curve,0.5)
		for s in surfaces:
			distances.append(dg.Geometry.DistanceTo(point,s))
		mindis = min(distances)
		ind = distances.IndexOf(mindis)
		wantedsurface = surfaces[ind]
		closestpoint = dg.Geometry.ClosestPointTo(wantedsurface,point)
		normal = dg.Surface.NormalAtPoint(wantedsurface,closestpoint)
		result.append(normal)
	else:
		result.append(v)
# Assign your output to the OUT variable.
OUT = result
# ----------------------------------------
python_script_2 = Python(IN[0]=chop, IN[1]=python_script)
# ---------- python_script_2.python (24 lines) ----------
# Load the Python Standard and DesignScript Libraries
import sys
import clr
clr.AddReference('ProtoGeometry')
from Autodesk.DesignScript.Geometry import *

# The inputs to this node will be stored as a list in the IN variables.
dataEnteringNode = IN

list1 = IN[0]
list2 = IN[1]

matched = []
counter = 0
for l in list1:
	tmp = []
	for l2 in l:
		tmp.append(list2[counter])
	matched.append(tmp)
	counter += 1
# Place your code below this line

# Assign your output to the OUT variable.
OUT = matched
# ----------------------------------------
flatten_6 = List.Flatten(list=python_script_2)
create_4 = List.Create(item0=vector_of_model_curve, item1=filterByBoolMask_2.out, item2=flatten_6)
clean_3 = List.Clean(list=create_4, preserveIndices=code_block_5)
flatten_7 = List.Flatten(list=clean_3)
VARVectors = Output(flatten_7)
code_block_6 = CodeBlock { 1; }
