# Dynamo custom node Geometry and Vector of Model Curves and Curve By Points.dyf (Dynamo 2.1.0.7500)
# category: Synthesize.Automate.Geometry
# Geometry and Vector of Model Curves and Curve By Points

VARElements = Input(VARElements: var[]..[])
code_block = CodeBlock { "ModelCurve"; "CurveByPoints"; "Elements.AdaptiveComponent"; }
byClassName = Custom[SP.Filter.ByClassName](VARobject=VARElements, VARclassName=code_block.out0)  # Filters a list of objects by the object's class name. Note that Dynamo elements belong to different classes than their Revit counterparts. Use the Object.Class node to check an object's class.
curves = Element.Curves(element=byClassName.VARin)
byClassName_2 = Custom[SP.Filter.ByClassName](VARobject=byClassName.VARout, VARclassName=code_block.out1)
helix_to_curves = Custom[Helix to Curves](VARHelixElements=byClassName_2.VARin)  # Helix to Curves
vector_of_curve_by_points = Custom[Vector of Curve By Points](VARCurveByPoints=byClassName_2.VARin, VARCurveGeometry=helix_to_curves)  # Vector of Curve By Points
isNull = Object.IsNull(obj=vector_of_curve_by_points)
filterByBoolMask = List.FilterByBoolMask(list=helix_to_curves, mask=isNull)
byClassName_3 = Custom[SP.Filter.ByClassName](VARobject=byClassName_2.VARout, VARclassName=code_block.out2)
curves_2 = Element.Curves(element=byClassName_3.VARin)
flatten = List.Flatten(list=curves_2)
create = List.Create(item0=curves, item1=filterByBoolMask.out, item2=flatten)
code_block_2 = CodeBlock { false; }
clean = List.Clean(list=create, preserveIndices=code_block_2)
flatten_2 = List.Flatten(list=clean)
VARCurves = Output(flatten_2)
vector_of_model_curve = Custom[Vector of Model Curve](VARModelCurves=byClassName.VARin)  # Vector of Model Curve
filterByBoolMask_2 = List.FilterByBoolMask(list=vector_of_curve_by_points, mask=isNull)
startPoint = Curve.StartPoint(curve=curves_2)
endPoint = Curve.EndPoint(curve=curves_2)
create_2 = List.Create(item0=startPoint, item1=endPoint)
transpose = List.Transpose(lists=create_2)
flatten_3 = List.Flatten(list=transpose@L3)
byBestFitThroughPoints = Plane.ByBestFitThroughPoints(points=flatten_3)
python_script = Python(IN[0]=curves_2, IN[1]=byBestFitThroughPoints)
# ---------- python_script.python (24 lines) ----------
# Load the Python Standard and DesignScript Libraries
import sys
import clr
clr.AddReference('ProtoGeometry')
from Autodesk.DesignScript.Geometry import *

# The inputs to this node will be stored as a list in the IN variables.
dataEnteringNode = IN

list1 = IN[0]
list2 = IN[1]

matched = []
counter = 0
for l in list1:
	tmp = []
	for l2 in l:
		tmp.append(list2[counter])
	matched.append(tmp)
	counter += 1
# Place your code below this line

# Assign your output to the OUT variable.
OUT = matched
# ----------------------------------------
normal = Plane.Normal(plane=python_script)
flatten_4 = List.Flatten(list=normal)
create_3 = List.Create(item0=vector_of_model_curve, item1=filterByBoolMask_2.out, item2=flatten_4)
clean_2 = List.Clean(list=create_3, preserveIndices=code_block_2)
flatten_5 = List.Flatten(list=clean_2)
VARVectors = Output(flatten_5)
