# Dynamo custom node Get Curtain System Grids Only.dyf (Dynamo 2.1.0.7500)
# category: Synthesize.Automate.Solid
# Get Curtain System Grids Only

VARCurtainSystems = Input(VARCurtainSystems: var[]..[])
turnIntoList = Custom[CW.TurnIntoList](VARunknownItem=VARCurtainSystems)  # Turns an element (or a nested list) into a flat list
python_script = Python(IN[0]=turnIntoList)
# ---------- python_script.python (108 lines) ----------
# Enable Python support and load DesignScript library
# IMPORTANT : ALL DYNAMO DESIGN SCRIPT NODES ARE AS (dg)
import clr
clr.AddReference('ProtoGeometry')
from Autodesk.DesignScript import Geometry as dg

# EXTENSION Enable ToDSType
clr.AddReference('RevitNodes')
import Revit
clr.ImportExtensions(Revit.Elements)

# Enable Revit Elements
from Revit.Elements import *

# EXTENSION Enable Geometry Conversion Methods
clr.ImportExtensions(Revit.GeometryConversion)

# Enable Revit API
clr.AddReference('RevitAPI')
from Autodesk.Revit.DB import *

# Enable DocumentManager and TransactionManager
clr.AddReference('RevitServices')
from RevitServices.Persistence import DocumentManager
from RevitServices.Transactions import TransactionManager

# Enable ICollection List Translate
clr.AddReference("System")
import System.Collections.Generic
from System.Collections.Generic import List

def flatten(x):
    result = []
    for el in x:
        if hasattr(el, "__iter__") and not isinstance(el, basestring):
            result.extend(flatten(el))
        else:
            result.append(el)
    return result
    
def tolist(obj1):
	if hasattr(obj1,'__iter__'): return obj1
	else: return [obj1]
	
def cellgrids(x):
	x = doc.GetElement(x)
	existedonly = x.SkippedSegmentCurves
	fullc = [x.FullCurve.ToProtoType()]
	listat = []
	for ex in existedonly:
		ex = ex.ToProtoType()
		stp = ex.StartPoint
		end = ex.EndPoint
		tmplist = []
		for fu in fullc:
			pt = dg.Curve.PointAtParameter(ex,0.5)
			if dg.Geometry.DoesIntersect(pt,fu):
				sparm = dg.Curve.ParameterAtPoint(fu,stp)
				eparm = dg.Curve.ParameterAtPoint(fu,end)
				trimmed = dg.Curve.TrimInteriorByParameter(fu,sparm,eparm)
				fixtrim = []
				for tr in trimmed:
					if tr.Length > 0:
						fixtrim.append(tr)
				tmplist.append(flatten(fixtrim))
				break
			else:
				tmplist.append(fu)
		fullc = flatten(tmplist)
	return fullc

def getsoul(csystem):
	grids = csystem.CurtainGrids
	gridlist = []
	gridlistv = []
	fuck = []
	for e in grids:
		cells = e.GetUGridLineIds()
		cellsv = e.GetVGridLineIds()
		tmp = []
		tmpv = []
		for x in cells:
			tmp.append(cellgrids(x))
		for x in cellsv:
			tmpv.append(cellgrids(x))
		gridlist.append(flatten(tmp))
		gridlistv.append(flatten(tmpv))
	return gridlist,gridlistv
	
dataEnteringNode = IN
# Use UnwrapElement(IN[0]) When Translating From Dynamo to Revit
curtains=UnwrapElement(tolist(IN[0]))

# Choose The Current Document
doc = DocumentManager.Instance.CurrentDBDocument
uidoc = DocumentManager.Instance.CurrentUIApplication.ActiveUIDocument
uiapp = DocumentManager.Instance.CurrentUIApplication
app = uiapp.Application
	
result = []
for e in curtains:
	if e.ToString() == "Autodesk.Revit.DB.CurtainSystem":
		try:
			result.append(getsoul(e))
		except:
			pass
# Assign your output to the OUT variable.
OUT = result
# ----------------------------------------
transpose = List.Transpose(lists=python_script@@L4)
python_script_2 = Python(IN[0]=transpose)
# ---------- python_script_2.python (14 lines) ----------
import clr
clr.AddReference('ProtoGeometry')
from Autodesk.DesignScript.Geometry import *
#The inputs to this node will be stored as a list in the IN variables.
dataEnteringNode = IN

input = IN[0]

result = []
for i in input:
	for s in i:
		result.append(s)
#Assign your output to the OUT variable.
OUT = result
# ----------------------------------------
VARGrids = Output(python_script_2)
