# Dynamo custom node Get Curtain System Grids and Sorted Faces.dyf (Dynamo 2.1.0.7500)
# category: Synthesize.Automate.Solid
# Get Curtain System Grids Only

VARGetorNot = Input(VARGetorNot: var[]..[])
VARFaces = Input(VARFaces: var[]..[])
turnIntoList = Custom[CW.TurnIntoList](VARunknownItem=VARFaces)  # Turns an element (or a nested list) into a flat list
empty = List.Empty()
scopeIf = Custom[CW.ScopeIf+](VARtest=VARGetorNot, VARtrue=turnIntoList, VARfalse=empty)  # A (hopefully) more robust implementation of ScopeIf. Tests a single boolean and returns a value accordingly.
flatten = List.Flatten(list=scopeIf)
python_script = Python()  # graph input
# ---------- python_script.python (45 lines) ----------
# Enable Python support and load DesignScript library
# IMPORTANT : ALL DYNAMO DESIGN SCRIPT NODES ARE AS (dg)
import clr
clr.AddReference('ProtoGeometry')
from Autodesk.DesignScript import Geometry as dg

# EXTENSION Enable ToDSType
clr.AddReference('RevitNodes')
import Revit
clr.ImportExtensions(Revit.Elements)

# Enable Revit Elements
from Revit.Elements import *

# EXTENSION Enable Geometry Conversion Methods
clr.ImportExtensions(Revit.GeometryConversion)

# Enable Revit API
clr.AddReference('RevitAPI')
from Autodesk.Revit.DB import *

# Enable DocumentManager and TransactionManager
clr.AddReference('RevitServices')
from RevitServices.Persistence import DocumentManager
from RevitServices.Transactions import TransactionManager

# Enable ICollection List Translate
clr.AddReference("System")
import System.Collections.Generic
from System.Collections.Generic import List

dataEnteringNode = IN
# Use UnwrapElement(IN[0]) When Translating From Dynamo to Revit

# Choose The Current Document
doc = DocumentManager.Instance.CurrentDBDocument
uidoc = DocumentManager.Instance.CurrentUIApplication.ActiveUIDocument
uiapp = DocumentManager.Instance.CurrentUIApplication
app = uiapp.Application

# Create Empty List
result = []

# Assign your output to the OUT variable.
OUT = doc.IsFamilyDocument
# ----------------------------------------
empty_2 = List.Empty()
VARCurtainSystems = Input(VARCurtainSystems: var[]..[])
turnIntoList_2 = Custom[CW.TurnIntoList](VARunknownItem=VARCurtainSystems)
scopeIf_2 = Custom[CW.ScopeIf+](VARtest=VARGetorNot, VARtrue=turnIntoList_2, VARfalse=empty_2)
scopeIf_3 = Custom[CW.ScopeIf+](VARtest=python_script, VARtrue=empty_2, VARfalse=scopeIf_2)
python_script_2 = Python(IN[0]=scopeIf_3)
# ---------- python_script_2.python (108 lines) ----------
# Enable Python support and load DesignScript library
# IMPORTANT : ALL DYNAMO DESIGN SCRIPT NODES ARE AS (dg)
import clr
clr.AddReference('ProtoGeometry')
from Autodesk.DesignScript import Geometry as dg

# EXTENSION Enable ToDSType
clr.AddReference('RevitNodes')
import Revit
clr.ImportExtensions(Revit.Elements)

# Enable Revit Elements
from Revit.Elements import *

# EXTENSION Enable Geometry Conversion Methods
clr.ImportExtensions(Revit.GeometryConversion)

# Enable Revit API
clr.AddReference('RevitAPI')
from Autodesk.Revit.DB import *

# Enable DocumentManager and TransactionManager
clr.AddReference('RevitServices')
from RevitServices.Persistence import DocumentManager
from RevitServices.Transactions import TransactionManager

# Enable ICollection List Translate
clr.AddReference("System")
import System.Collections.Generic
from System.Collections.Generic import List

def flatten(x):
    result = []
    for el in x:
        if hasattr(el, "__iter__") and not isinstance(el, basestring):
            result.extend(flatten(el))
        else:
            result.append(el)
    return result
    
def tolist(obj1):
	if hasattr(obj1,'__iter__'): return obj1
	else: return [obj1]
	
def cellgrids(x):
	x = doc.GetElement(x)
	existedonly = x.SkippedSegmentCurves
	fullc = [x.FullCurve.ToProtoType()]
	listat = []
	for ex in existedonly:
		ex = ex.ToProtoType()
		stp = ex.StartPoint
		end = ex.EndPoint
		tmplist = []
		for fu in fullc:
			pt = dg.Curve.PointAtParameter(ex,0.5)
			if dg.Geometry.DoesIntersect(pt,fu):
				sparm = dg.Curve.ParameterAtPoint(fu,stp)
				eparm = dg.Curve.ParameterAtPoint(fu,end)
				trimmed = dg.Curve.TrimInteriorByParameter(fu,sparm,eparm)
				fixtrim = []
				for tr in trimmed:
					if tr.Length > 0:
						fixtrim.append(tr)
				tmplist.append(flatten(fixtrim))
				break
			else:
				tmplist.append(fu)
		fullc = flatten(tmplist)
	return fullc

def getsoul(csystem):
	grids = csystem.CurtainGrids
	gridlist = []
	gridlistv = []
	fuck = []
	for e in grids:
		cells = e.GetUGridLineIds()
		cellsv = e.GetVGridLineIds()
		tmp = []
		tmpv = []
		for x in cells:
			tmp.append(cellgrids(x))
		for x in cellsv:
			tmpv.append(cellgrids(x))
		gridlist.append(flatten(tmp))
		gridlistv.append(flatten(tmpv))
	return gridlist,gridlistv
	
dataEnteringNode = IN
# Use UnwrapElement(IN[0]) When Translating From Dynamo to Revit
curtains=UnwrapElement(tolist(IN[0]))

# Choose The Current Document
doc = DocumentManager.Instance.CurrentDBDocument
uidoc = DocumentManager.Instance.CurrentUIApplication.ActiveUIDocument
uiapp = DocumentManager.Instance.CurrentUIApplication
app = uiapp.Application
	
result = []
for e in curtains:
	if e.ToString() == "Autodesk.Revit.DB.CurtainSystem":
		try:
			result.append(getsoul(e))
		except:
			pass
# Assign your output to the OUT variable.
OUT = result
# ----------------------------------------
transpose = List.Transpose(lists=python_script_2@@L4)
python_script_3 = Python(IN[0]=transpose)
# ---------- python_script_3.python (14 lines) ----------
import clr
clr.AddReference('ProtoGeometry')
from Autodesk.DesignScript.Geometry import *
#The inputs to this node will be stored as a list in the IN variables.
dataEnteringNode = IN

input = IN[0]

result = []
for i in input:
	for s in i:
		result.append(s)
#Assign your output to the OUT variable.
OUT = result
# ----------------------------------------
python_empty_2_null = Custom[Python Empty 2 Null](VARIN=python_script_3@L3)  # Python Null 2 Empty
flatten_2 = List.Flatten(list=python_empty_2_null@L3)
code_block = CodeBlock { false; }
clean = List.Clean(list=flatten_2, preserveIndices=code_block)
firstItem = List.FirstItem(list=clean@L2)
join = List.Join()  # unwired: list0, list1
code_block_2 = CodeBlock { 0.9; 0.1; }
pointAtParameter = Curve.PointAtParameter(curve=firstItem, param=code_block_2.out0)
pointAtParameter_2 = Curve.PointAtParameter(curve=firstItem, param=code_block_2.out1)
combine = List.Combine(comb=join, list1=pointAtParameter, list2=pointAtParameter_2)
splitByPoints = Curve.SplitByPoints(curve=firstItem, points=combine)
code_block_3 = CodeBlock { 1; }
getItemAtIndex = List.GetItemAtIndex(list=splitByPoints@L2, index=code_block_3)
count = List.Count(list=getItemAtIndex)
ofRepeatedItem = List.OfRepeatedItem(item=flatten, amount=count)
VAROriginalFaces = Input(VAROriginalFaces: var[]..[])
turnIntoList_3 = Custom[CW.TurnIntoList](VARunknownItem=VAROriginalFaces)
empty_3 = List.Empty()
scopeIf_4 = Custom[CW.ScopeIf+](VARtest=VARGetorNot, VARtrue=turnIntoList_3, VARfalse=empty_3)
flatten_3 = List.Flatten(list=scopeIf_4)
doesIntersect = Geometry.DoesIntersect(geometry=flatten_3, other=getItemAtIndex@L1)
filterByBoolMask = List.FilterByBoolMask(list=ofRepeatedItem, mask=doesIntersect)
code_block_4 = CodeBlock { false; }
clean_2 = List.Clean(list=filterByBoolMask.in, preserveIndices=code_block_4)
flatten_4 = List.Flatten(list=clean_2)
scopeIf_5 = Custom[CW.ScopeIf+](VARtest=VARGetorNot, VARtrue=flatten_4, VARfalse=VARFaces)
VARSortedFaces = Output(scopeIf_5)
ofRepeatedItem_2 = List.OfRepeatedItem(item=flatten_3, amount=count)
filterByBoolMask_2 = List.FilterByBoolMask(list=ofRepeatedItem_2, mask=doesIntersect)
code_block_5 = CodeBlock { false; }
clean_3 = List.Clean(list=filterByBoolMask_2.in, preserveIndices=code_block_5)
flatten_5 = List.Flatten(list=clean_3)
allFalse = List.AllFalse(list=doesIntersect@L2)
filterByBoolMask_3 = List.FilterByBoolMask(list=python_empty_2_null, mask=allFalse)
firstItem_2 = List.FirstItem(list=filterByBoolMask_3.out@@L3)
lastItem = List.LastItem(list=filterByBoolMask_3.out@@L3)
python_script_4 = Python(IN[0]=flatten_5, IN[1]=firstItem_2, IN[2]=lastItem)
# ---------- python_script_4.python (106 lines) ----------
# Enable Python support and load DesignScript library
# IMPORTANT : ALL DYNAMO DESIGN SCRIPT NODES ARE AS (dg)
import clr
clr.AddReference('ProtoGeometry')
from Autodesk.DesignScript import Geometry as dg

# EXTENSION Enable ToDSType
clr.AddReference('RevitNodes')
import Revit
clr.ImportExtensions(Revit.Elements)

# Enable Revit Elements
from Revit.Elements import *

# EXTENSION Enable Geometry Conversion Methods
clr.ImportExtensions(Revit.GeometryConversion)

# Enable Revit API
clr.AddReference('RevitAPI')
from Autodesk.Revit.DB import *

# Enable DocumentManager and TransactionManager
clr.AddReference('RevitServices')
from RevitServices.Persistence import DocumentManager
from RevitServices.Transactions import TransactionManager

# Enable ICollection List Translate
clr.AddReference("System")
import System.Collections.Generic
from System.Collections.Generic import List

dataEnteringNode = IN
# Use UnwrapElement(IN[0]) When Translating From Dynamo to Revit
faces=UnwrapElement(IN[0])
u=UnwrapElement(IN[1])
v=UnwrapElement(IN[2])

# Choose The Current Document
doc = DocumentManager.Instance.CurrentDBDocument
uidoc = DocumentManager.Instance.CurrentUIApplication.ActiveUIDocument
uiapp = DocumentManager.Instance.CurrentUIApplication
app = uiapp.Application

# Create Empty List
result = []
newU = []
newV = []
countU = []
countV = []
flipstatus = []

counter = 0
for f in faces:
	try:
		isoU = dg.Curve.ByIsoCurveOnSurface(f,0,0)
	except:
		isoU = dg.Curve.ByIsoCurveOnSurface(f,0,0.001)
	try:
		isoV = dg.Curve.ByIsoCurveOnSurface(f,1,0)
	except:
		isoV = dg.Curve.ByIsoCurveOnSurface(f,1,0.001)
	currentU = u[counter]
	currentV = v[counter]
	counter += 1
	ustatus = False
	if currentU != None:
		for g in currentU:
			if round(dg.Geometry.DistanceTo(isoU,g),2) == 0:
				ustatus = True
				break
			else:
				ustatus = False
	vstatus = False				
	if currentV != None:
		for g in currentV:
			if round(dg.Geometry.DistanceTo(isoV,g),2) == 0:
				vstatus = True
				break
			else:
				vstatus = False
	if ustatus == True or vstatus == True:
		newU.append(currentU)
		try:
			countU.append(len(currentU))
		except:
			countU.append(0)
		newV.append(currentV)
		try:
			countV.append(len(currentV))
		except:
			countV.append(0)
		flipstatus.append(False)
	else:
		newU.append(currentV)
		try:
			countU.append(len(currentV))
		except:
			countU.append(0)
		newV.append(currentU)
		try:
			countV.append(len(currentU))
		except:
			countV.append(0)
		flipstatus.append(True)
# Assign your output to the OUT variable.
OUT = faces,newU,newV,countU,countV,flipstatus
# ----------------------------------------
code_block_6 = CodeBlock(a=python_script_4) { a[0]; a[1]; a[2]; a[3]; a[4]; a[5]; }
code_block_7 = CodeBlock { 2; }
normalizeDepth = List.NormalizeDepth(list=code_block_6.out1, rank=code_block_7)
VARGridsU = Output(normalizeDepth)
normalizeDepth_2 = List.NormalizeDepth(list=code_block_6.out2, rank=code_block_7)
VARGridsV = Output(normalizeDepth_2)
VARCountU = Output(code_block_6.out3)
VARCountV = Output(code_block_6.out4)
VARFlipStatus = Output(code_block_6.out5)
