# Dynamo custom node Get Curtain System or Divided Surface.dyf (Dynamo 2.1.0.7500)
# category: Synthesize.Automate.Surface
# Get Curtain System or Divided Surface

VARFaces = Input(VARFaces: var[]..[])
python_script = Python(IN[0]=VARFaces)
# ---------- python_script.python (55 lines) ----------
# Enable Python support and load DesignScript library
# IMPORTANT : ALL DYNAMO DESIGN SCRIPT NODES ARE AS (dg)
import clr
clr.AddReference('ProtoGeometry')
from Autodesk.DesignScript import Geometry as dg

# EXTENSION Enable ToDSType
clr.AddReference('RevitNodes')
import Revit
clr.ImportExtensions(Revit.Elements)

# Enable Revit Elements
from Revit.Elements import *

# EXTENSION Enable Geometry Conversion Methods
clr.ImportExtensions(Revit.GeometryConversion)

# Enable Revit API
clr.AddReference('RevitAPI')
from Autodesk.Revit.DB import *

# Enable DocumentManager and TransactionManager
clr.AddReference('RevitServices')
from RevitServices.Persistence import DocumentManager
from RevitServices.Transactions import TransactionManager

# Enable ICollection List Translate
clr.AddReference("System")
import System.Collections.Generic
from System.Collections.Generic import List

dataEnteringNode = IN
# Use UnwrapElement(IN[0]) When Translating From Dynamo to Revit

# Choose The Current Document
doc = DocumentManager.Instance.CurrentDBDocument
uidoc = DocumentManager.Instance.CurrentUIApplication.ActiveUIDocument
uiapp = DocumentManager.Instance.CurrentUIApplication
app = uiapp.Application

# Create Empty List
result = []
isfamily = doc.IsFamilyDocument

surfs = IN[0]

if isfamily:
	outsystem = []
	divsurfs = surfs
else:
	outsystem = surfs
	divsurfs = []
	
# Assign your output to the OUT variable.
OUT = isfamily,outsystem,divsurfs
# ----------------------------------------
code_block = CodeBlock(a=python_script) { a[0]; a[1]; a[2]; }
get_divided_surface_smooth_lines = Custom[Get Divided Surface Smooth Lines By Surfaces Selection](VARSurfaces=code_block.out2)  # Get Divided Surface Smooth Lines By Surfaces Selection
VARCurtainSystems = Input(VARCurtainSystems: var[]..[])
VARGetorNot = Input(VARGetorNot: var[]..[])
VAROriginalFaces = Input(VAROriginalFaces: var[]..[])
get_curtain_system_grids_and = Custom[Get Curtain System Grids and Sorted Faces](VARCurtainSystems=VARCurtainSystems, VARFaces=code_block.out1, VARGetorNot=VARGetorNot, VAROriginalFaces=VAROriginalFaces)  # Get Curtain System Grids Only
python_script_2 = Python(IN[0]=get_divided_surface_smooth_lines.VARSurfaces, IN[1]=get_divided_surface_smooth_lines.VARUGrid, IN[2]=get_divided_surface_smooth_lines.VARVGrid, IN[3]=get_divided_surface_smooth_lines.VARCountU, IN[4]=get_divided_surface_smooth_lines.VARVCountV, IN[5]=get_divided_surface_smooth_lines.VARFlipStatus, IN[6]=get_curtain_system_grids_and.VARSortedFaces, IN[7]=get_curtain_system_grids_and.VARGridsU, IN[8]=get_curtain_system_grids_and.VARGridsV, IN[9]=get_curtain_system_grids_and.VARCountU, IN[10]=get_curtain_system_grids_and.VARCountV, IN[11]=get_curtain_system_grids_and.VARFlipStatus, IN[12]=code_block.out0, IN[13]=VARGetorNot, IN[14]=VAROriginalFaces)
# ---------- python_script_2.python (20 lines) ----------
import clr
clr.AddReference('ProtoGeometry')
from Autodesk.DesignScript.Geometry import *
#The inputs to this node will be stored as a list in the IN variables.
dataEnteringNode = IN

isfamily = IN[12]
getornot = IN[13]
orgsurfs = IN[14]

if isfamily:
	if getornot:
		OUT = IN[0],IN[1],IN[2],IN[3],IN[4],IN[5]
	else:
		OUT = orgsurfs,IN[1],IN[2],IN[3],IN[4],IN[5]
else:
	if getornot:
		OUT = IN[6],IN[7],IN[8],IN[9],IN[10],IN[11]
	else:
		OUT = orgsurfs,IN[7],IN[8],IN[9],IN[10],IN[11]
# ----------------------------------------
code_block_2 = CodeBlock(a=python_script_2) { a[0]; a[1]; a[2]; a[3]; a[4]; a[5]; }
VARSurfaces = Output(code_block_2.out0)
VARUGrid = Output(code_block_2.out1)
VARVGrid = Output(code_block_2.out2)
VARCountU = Output(code_block_2.out3)
VARCountV = Output(code_block_2.out4)
VARFlipStatus = Output(code_block_2.out5)
