# Dynamo custom node Get Divided Surfaces of Surfaces.dyf (Dynamo 2.1.0.7500)
# category: Synthesize.Automate.DividedSurface
# Get Divided Surfaces of Surfaces

VARSurfaces = Input(VARSurfaces: var[]..[])
turnIntoList = Custom[CW.TurnIntoList](VARunknownItem=VARSurfaces)  # Turns an element (or a nested list) into a flat list
python_script = Python(IN[0]=turnIntoList)
# ---------- python_script.python (58 lines) ----------
# Enable Python support and load DesignScript library
# IMPORTANT : ALL DYNAMO DESIGN SCRIPT NODES ARE AS (dg)
import clr
clr.AddReference('ProtoGeometry')
from Autodesk.DesignScript import Geometry as dg

# EXTENSION Enable ToDSType
clr.AddReference('RevitNodes')
import Revit
clr.ImportExtensions(Revit.Elements)

# Enable Revit Elements
from Revit.Elements import *

# EXTENSION Enable Geometry Conversion Methods
clr.ImportExtensions(Revit.GeometryConversion)

# Enable Revit API
clr.AddReference('RevitAPI')
from Autodesk.Revit.DB import *

# Enable DocumentManager and TransactionManager
clr.AddReference('RevitServices')
from RevitServices.Persistence import DocumentManager
from RevitServices.Transactions import TransactionManager

# Enable ICollection List Translate
clr.AddReference("System")
import System.Collections.Generic
from System.Collections.Generic import List

dataEnteringNode = IN
# Use UnwrapElement(IN[0]) When Translating From Dynamo to Revit
faces=UnwrapElement(IN[0])

# Choose The Current Document
doc = DocumentManager.Instance.CurrentDBDocument
uidoc = DocumentManager.Instance.CurrentUIApplication.ActiveUIDocument
uiapp = DocumentManager.Instance.CurrentUIApplication
app = uiapp.Application

# Create Empty List
result = []

for f in faces:
	ref = f.Tags.LookupTag("RevitFaceReference")
	attempt = DividedSurface.GetDividedSurfaceForReference(doc,ref)
	if attempt != None:
		result.append(attempt)
	else:
		elem = doc.GetElement(ref)
		if hasattr(elem, 'GetTileFamilyInstance'):
			result.append(elem)
		else:
			result.append(None)
			
# Assign your output to the OUT variable.
OUT = result
# ----------------------------------------
VARDividedSurfaces = Output(python_script)
