# Dynamo custom node Get Stairs Bottom Surfaces.dyf (Dynamo 2.1.0.7500)
# category: Synthesize.Automate.Surface
# Get Stairs Bottom Surfaces

VARSolidGeometry = Input(VARSolidGeometry: var[]..[])
explode = Geometry.Explode(geometry=VARSolidGeometry)
flatten = List.Flatten(list=explode)
code_block = CodeBlock { 0.5; }
normalAtParameter = Surface.NormalAtParameter(surface=flatten, u=code_block, v=code_block)
Z = Vector.Z(vector=normalAtParameter)
code_block_2 = CodeBlock { 0; }
lt = Z < code_block_2
filterByBoolMask = List.FilterByBoolMask(list=flatten, mask=lt)
flatten_2 = List.Flatten(list=filterByBoolMask.in)
VARIgnoreSurfacesWithAreaLessThan = Input(VARIgnoreSurfacesWithAreaLessThan: double = 0.2)
python_script = Python(IN[0]=flatten_2, IN[1]=VARIgnoreSurfacesWithAreaLessThan)
# ---------- python_script.python (76 lines) ----------
# Enable Python support and load DesignScript library
# IMPORTANT : ALL DYNAMO DESIGN SCRIPT NODES ARE AS (dg)
import clr
clr.AddReference('ProtoGeometry')
from Autodesk.DesignScript import Geometry as dg

# EXTENSION Enable ToDSType
clr.AddReference('RevitNodes')
import Revit
clr.ImportExtensions(Revit.Elements)

# Enable Revit Elements
from Revit.Elements import *

# EXTENSION Enable Geometry Conversion Methods
clr.ImportExtensions(Revit.GeometryConversion)

# Enable Revit API
clr.AddReference('RevitAPI')
from Autodesk.Revit.DB import *

# Enable DocumentManager and TransactionManager
clr.AddReference('RevitServices')
from RevitServices.Persistence import DocumentManager
from RevitServices.Transactions import TransactionManager
clr.AddReference('DynamoRevitDS')
import Dynamo 
# Enable ICollection List Translate
clr.AddReference("System")
import System.Collections.Generic
from System.Collections.Generic import List

dataEnteringNode = IN
# Use UnwrapElement(IN[0]) When Translating From Dynamo to Revit
surfaces = UnwrapElement(IN[0])
areatoignore = IN[1]

fixedlist = []
for s in surfaces:
	fixedlist.append(s)
surfaces = fixedlist

# Choose The Current Document
doc = DocumentManager.Instance.CurrentDBDocument
uidoc = DocumentManager.Instance.CurrentUIApplication.ActiveUIDocument
uiapp = DocumentManager.Instance.CurrentUIApplication
app = uiapp.Application

f = dg.BoundingBox.ByGeometry(surfaces)
cub = f.ToCuboid()
height = cub.Height
cub.Dispose()
allsurfs = surfaces
count = 0
good = []

for s in allsurfs:
	pt = dg.Surface.PointAtParameter(s,0.5,0.5)
	norm = dg.Surface.NormalAtParameter(s,0.5,0.5)
	line = dg.Line.ByStartPointDirectionLength(pt,norm,height)
	innercount = 0
	safe = []
	safe.append(True)
	for s2 in allsurfs:
		if count != innercount and dg.Geometry.DoesIntersect(s2,line) and s.Area * 0.8 < s2.Area:
			safe.append(False)
			break
		innercount += 1
	if (all(safe) and s.Area > areatoignore) or (all(safe) and norm.Z == -1):
		good.append(s)
	count += 1
heights = height
result = good

# Assign your output to the OUT variable.
OUT = result,heights
# ----------------------------------------
code_block_3 = CodeBlock(a=python_script) { a[0]; a[1]; }
flatten_3 = List.Flatten(list=code_block_3.out0)
VARSurfaces = Output(flatten_3)
maximumItem = List.MaximumItem(list=code_block_3.out1)
VARHeight = Output(maximumItem)
