# Dynamo custom node Get View Range Settings.dyf (Dynamo 2.1.0.7500)
# category: Synthesize.Automate.Views
# Get View Range Settings

VARViews = Input(VARViews: var[]..[])
python_get_view_range_settings = Python(IN[0]=VARViews)
# ---------- python_get_view_range_settings.python (44 lines) ----------
import clr
clr.AddReference('RevitAPI')
from Autodesk.Revit.DB import *

clr.AddReference("RevitNodes")
import Revit
clr.ImportExtensions(Revit.Elements)

clr.AddReference("RevitServices")
import RevitServices
from RevitServices.Persistence import DocumentManager
from RevitServices.Transactions import TransactionManager

doc = DocumentManager.Instance.CurrentDBDocument
viewList = UnwrapElement(IN[0])

topC_lvl=[]
topC_Off=[]
cutP_lvl=[]
cutP_Off=[]
botP_lvl=[]
botP_Off=[]
dpthP_lvl=[]
dpthP_Off=[]
undrP_lvl=[]
undrP_Off=[]

for v in viewList:
	topC_lvl.append(doc.GetElement(v.GetViewRange().GetLevelId(PlanViewPlane.TopClipPlane)))
	topC_Off.append(v.GetViewRange().GetOffset(PlanViewPlane.TopClipPlane))
	cutP_lvl.append(doc.GetElement(v.GetViewRange().GetLevelId(PlanViewPlane.CutPlane)))
	cutP_Off.append(v.GetViewRange().GetOffset(PlanViewPlane.CutPlane))
	botP_lvl.append(doc.GetElement(v.GetViewRange().GetLevelId(PlanViewPlane.BottomClipPlane)))
	botP_Off.append(v.GetViewRange().GetOffset(PlanViewPlane.BottomClipPlane))
	dpthP_lvl.append(doc.GetElement(v.GetViewRange().GetLevelId(PlanViewPlane.ViewDepthPlane)))
	dpthP_Off.append(v.GetViewRange().GetOffset(PlanViewPlane.ViewDepthPlane))

TransactionManager.Instance.EnsureInTransaction(doc)


	
TransactionManager.Instance.TransactionTaskDone()

OUT = [topC_lvl, topC_Off, cutP_lvl, cutP_Off, botP_lvl, botP_Off, dpthP_lvl, dpthP_Off]
# ----------------------------------------
VARResult = Output(python_get_view_range_settings)
