# Dynamo custom node HOT.CutGeometry Solid with Solid.dyf (Dynamo 2.1.0.7500)
# category: Synthesize.Packages.Hot Gear.Geometry Cut

VARElementList = Input(VARElementList: var[]..[])
python_script = Python(IN[0]=VARElementList)
# ---------- python_script.python (34 lines) ----------
import clr
clr.AddReference('ProtoGeometry')
from Autodesk.DesignScript.Geometry import *

clr.AddReference("RevitAPI")
import Autodesk
from Autodesk.Revit.DB import *

clr.AddReference("RevitServices")
import RevitServices
from RevitServices.Persistence import DocumentManager
from RevitServices.Transactions import TransactionManager
from System.Collections.Generic import *

clr.AddReference("RevitNodes")
import Revit
clr.ImportExtensions(Revit.Elements)

doc = DocumentManager.Instance.CurrentDBDocument
TransactionManager.Instance.EnsureInTransaction(doc)

element = UnwrapElement(IN[0])

end = []
sublist = []

for CBCWV in element:
	result = Autodesk.Revit.DB.SolidSolidCutUtils.IsAllowedForSolidCut(CBCWV)
	sublist.append(result)
		
end.extend(sublist)

TransactionManager.Instance.TransactionTaskDone()
OUT = end
# ----------------------------------------
filterByBoolMask = List.FilterByBoolMask(list=VARElementList, mask=python_script)
join = List.Join(list0=filterByBoolMask.in, list1=filterByBoolMask.out)
code_block = CodeBlock(item=join) { a=Flatten([item]); List.Combinations(a,2,false); }
python_script_2 = Python(IN[0]=code_block.out1)
# ---------- python_script_2.python (38 lines) ----------
import clr
clr.AddReference('ProtoGeometry')
from Autodesk.DesignScript.Geometry import *

clr.AddReference("RevitAPI")
import Autodesk
from Autodesk.Revit.DB import *

clr.AddReference("RevitServices")
import RevitServices
from RevitServices.Persistence import DocumentManager
from RevitServices.Transactions import TransactionManager
from System.Collections.Generic import *

clr.AddReference("RevitNodes")
import Revit
clr.ImportExtensions(Revit.Elements)

doc = DocumentManager.Instance.CurrentDBDocument
TransactionManager.Instance.EnsureInTransaction(doc)

element = UnwrapElement(IN[0])
list = len(element)
count = 0
sublist = []

while (count < list):
	try:
		result = Autodesk.Revit.DB.SolidSolidCutUtils.AddCutBetweenSolids(doc, element[count][0], element[count][1])
		count
		count = count + 1
		sublist.append("Success")
	except:
		count
		count = count +1

TransactionManager.Instance.TransactionTaskDone()
OUT = sublist
# ----------------------------------------
VAROUT = Output(python_script_2)
