# Dynamo custom node HOT.JoinGeometry.dyf (Dynamo 2.1.0.7500)
# category: Synthesize.Packages.Hot Gear.Geometry Join
# Join Selected Geometry

VARElementlist = Input(VARElementlist: var[]..[])
python_script = Python(IN[0]=VARElementlist)
# ---------- python_script.python (34 lines) ----------
import clr
clr.AddReference('ProtoGeometry')
from Autodesk.DesignScript.Geometry import *

clr.AddReference("RevitAPI")
import Autodesk
from Autodesk.Revit.DB import *

clr.AddReference("RevitServices")
import RevitServices
from RevitServices.Persistence import DocumentManager
from RevitServices.Transactions import TransactionManager
from System.Collections.Generic import *

clr.AddReference("RevitNodes")
import Revit
clr.ImportExtensions(Revit.Elements)

doc = DocumentManager.Instance.CurrentDBDocument
TransactionManager.Instance.EnsureInTransaction(doc)

element = UnwrapElement(IN[0])

list = len(element)
count = 0
end = []

while (count < list):
		result = Autodesk.Revit.DB.JoinGeometryUtils.AreElementsJoined(doc, element[count][0], element[count][1])
		count = count + 1
		end.append(result)

TransactionManager.Instance.TransactionTaskDone()
OUT = end
# ----------------------------------------
filterByBoolMask = List.FilterByBoolMask(list=VARElementlist, mask=python_script)
python_script_2 = Python(IN[0]=filterByBoolMask.out)
# ---------- python_script_2.python (34 lines) ----------
import clr
clr.AddReference('ProtoGeometry')
from Autodesk.DesignScript.Geometry import *

clr.AddReference("RevitAPI")
import Autodesk
from Autodesk.Revit.DB import *

clr.AddReference("RevitServices")
import RevitServices
from RevitServices.Persistence import DocumentManager
from RevitServices.Transactions import TransactionManager
from System.Collections.Generic import *

clr.AddReference("RevitNodes")
import Revit
clr.ImportExtensions(Revit.Elements)

doc = DocumentManager.Instance.CurrentDBDocument
TransactionManager.Instance.EnsureInTransaction(doc)

elements = UnwrapElement(IN[0])
count = 0
result = []
while (count < len(elements)):
	try:
		Autodesk.Revit.DB.JoinGeometryUtils.JoinGeometry(doc, elements[count][0], elements[count][1])
		count = count + 1
		result.append("Success")
	except:
		count = count +1

TransactionManager.Instance.TransactionTaskDone()
OUT = result
# ----------------------------------------
VARSuccess = Output(python_script_2)
VARAlreadyJoined = Output(filterByBoolMask.in)
