# Dynamo custom node HOT.SwitchJoinGeometry.dyf (Dynamo 2.1.0.7500)
# category: Synthesize.Packages.Hot Gear.Geometry Join
# Join Selected Geometry

VARElementlist = Input(VARElementlist: var[]..[])
code_block = CodeBlock(item=VARElementlist) { a=DSCore.List.Flatten([item]); List.Combinations(a,2,false); }
python_script = Python(IN[0]=code_block.out1)
# ---------- python_script.python (34 lines) ----------
import clr
clr.AddReference('ProtoGeometry')
from Autodesk.DesignScript.Geometry import *

clr.AddReference("RevitAPI")
import Autodesk
from Autodesk.Revit.DB import *

clr.AddReference("RevitServices")
import RevitServices
from RevitServices.Persistence import DocumentManager
from RevitServices.Transactions import TransactionManager
from System.Collections.Generic import *

clr.AddReference("RevitNodes")
import Revit
clr.ImportExtensions(Revit.Elements)

doc = DocumentManager.Instance.CurrentDBDocument
TransactionManager.Instance.EnsureInTransaction(doc)

element = UnwrapElement(IN[0])

list = len(element)
count = 0
end = []

while (count < list):
		result = Autodesk.Revit.DB.JoinGeometryUtils.AreElementsJoined(doc, element[count][0], element[count][1])
		count = count + 1
		end.append(result)

TransactionManager.Instance.TransactionTaskDone()
OUT = end
# ----------------------------------------
filterByBoolMask = List.FilterByBoolMask(list=code_block.out1, mask=python_script)
VARAlreadyJoined = Output(filterByBoolMask.in)
