# Dynamo custom node Honeycombs Paneling.dyf (Dynamo 2.1.0.7500)
# category: Synthesize.Automate.Adaptive
# Honeycombs Paneling

VARSurfaces = Input(VARSurfaces: var[]..[])
flatten = List.Flatten(list=VARSurfaces)
VARU = Input(VARU: var[]..[])
VARV = Input(VARV: var[]..[])
code_block = CodeBlock(u=VARU, v=VARV)
# ---------- code_block.designscript (6 lines) ----------
//Hexagon Points Grid
s = 1;
a = s/(2*Math.Tan(30));
p1 = Point.ByCoordinates((0..#u..s*3)<1>,(0..#v..a*2)<2>);
p2 = List.Flatten(p1<1>.Translate([0,s*1.5]<2>,[0,a]<2>,0),1);
p3 = Polygon.RegularPolygon(Circle.ByCenterPointRadius(p2,s),6).Points;
# ----------------------------------------
byPoints = Polygon.ByPoints(points=code_block.p3)
flatten_2 = List.Flatten(list=byPoints)
byGeometry = BoundingBox.ByGeometry(geom=flatten_2)
toCuboid = BoundingBox.ToCuboid(boundingBox=byGeometry)
explode = Geometry.Explode(geometry=toCuboid)
code_block_2 = CodeBlock(a=explode) { a[0]; }
create = List.Create()  # unwired: item0, item1
flatten_3 = List.Flatten(list=code_block.p3@L2)
code_block_3 = CodeBlock { 1; }
ofRepeatedItem = List.OfRepeatedItem(item=flatten_3, amount=code_block_3)
byPoints_2 = Polygon.ByPoints(points=ofRepeatedItem)
byPatch = Surface.ByPatch(closedCurve=byPoints)
flatten_4 = List.Flatten(list=byPatch)
python_script = Python(IN[0]=explode, IN[1]=flatten_4)
# ---------- python_script.python (37 lines) ----------
import clr
clr.AddReference('ProtoGeometry')
import Autodesk.DesignScript.Geometry as dg
#The inputs to this node will be stored as a list in the IN variables.
dataEnteringNode = IN

mainsurf = UnwrapElement(IN[0])
minisurfs = UnwrapElement(IN[1])

mainsol = dg.Surface.Thicken(mainsurf[0],1,True)
minisols = []

for e in minisurfs:
	minisols.append(dg.Surface.Thicken(e,1,True))

unioned = dg.Solid.ByUnion(minisols)

for each in minisols:
	each.Dispose()

diff = dg.Solid.Difference(mainsol, unioned)

mainsol.Dispose()

exploded = dg.Geometry.Explode(diff)

surfs = []
for e in exploded:
	tmpvec = dg.Surface.NormalAtParameter(e,0.5,0.5)
	if dg.Vector.IsAlmostEqualTo(tmpvec,dg.Vector.ZAxis().Reverse()):
		surfs.append(e.PerimeterCurves())

for e in exploded:
	e.Dispose()

#Assign your output to the OUT variable.
OUT = surfs
# ----------------------------------------
ZAxis = Vector.ZAxis()
code_block_4 = CodeBlock { 0.5; }
translate = Geometry.Translate(geometry=python_script, direction=ZAxis, distance=code_block_4)
startPoint = Curve.StartPoint(curve=translate)
ofRepeatedItem_2 = List.OfRepeatedItem(item=startPoint, amount=code_block_3)
byPoints_3 = Polygon.ByPoints(points=ofRepeatedItem_2)
create_2 = List.Create(item0=byPoints_2, item1=byPoints_3)
code_block_5 = CodeBlock { false; }
clean = List.Clean(list=create_2, preserveIndices=code_block_5)
flatten_5 = List.Flatten(list=clean@L3)
points = Polygon.Points(polygon=flatten_5)
count = List.Count()  # unwired: list
sortByFunction = List.SortByFunction(list=points@L3, func=count)
groupByFunction = List.GroupByFunction(list=sortByFunction@L3, func=count)
code_block_6 = CodeBlock(a=groupByFunction) { a[1]; }
byPoints_4 = Polygon.ByPoints(points=code_block_6)
byPatch_2 = Surface.ByPatch(closedCurve=byPoints_4)
code_block_7 = CodeBlock { 2; }
getItemAtIndex = List.GetItemAtIndex(list=byPatch_2, index=code_block_7)
code_block_8 = CodeBlock { 2; }
chop = List.Chop(list=getItemAtIndex, lengths=code_block_8)
lastItem = List.LastItem(list=chop@L2)
code_block_9 = CodeBlock(a=groupByFunction) { a[1]; }
getItemAtIndex_2 = List.GetItemAtIndex(list=code_block_9, index=code_block_7)
chop_2 = List.Chop(list=getItemAtIndex_2, lengths=code_block_8)
code_block_10 = CodeBlock { 0; 2; 1; }
getItemAtIndex_3 = List.GetItemAtIndex(list=chop_2@L3, index=code_block_10.out2)
code_block_11 = CodeBlock { 2; 4; }
getItemAtIndex_4 = List.GetItemAtIndex(list=getItemAtIndex_3@L2, index=code_block_11.out0)
getItemAtIndex_5 = List.GetItemAtIndex(list=getItemAtIndex_3@L2, index=code_block_11.out1)
byStartPointEndPoint = Line.ByStartPointEndPoint(startPoint=getItemAtIndex_4, endPoint=getItemAtIndex_5)
split = Geometry.Split(geometry=lastItem, other=byStartPointEndPoint)
perimeterCurves = Surface.PerimeterCurves(surface=split)
startPoint_2 = Curve.StartPoint(curve=perimeterCurves)
firstItem = List.FirstItem(list=startPoint_2@L3)
lastItem_2 = List.LastItem(list=startPoint_2@L3)
reverse = List.Reverse(list=lastItem_2@L2)
combine = List.Combine(comb=create, list1=firstItem, list2=reverse)
flatten_6 = List.Flatten(list=combine@L2)
removeItemAtIndex = List.RemoveItemAtIndex(list=code_block_9, indices=code_block_7)
reverse_2 = List.Reverse(list=removeItemAtIndex@L2)
flatten_7 = List.Flatten(list=reverse_2@L2)
code_block_12 = CodeBlock(a=groupByFunction) { a[0]; }
flatten_8 = List.Flatten(list=code_block_12@L2)
create_3 = List.Create()  # unwired: item0, item1
firstItem_2 = List.FirstItem(list=chop@L2)
getItemAtIndex_6 = List.GetItemAtIndex(list=chop_2@L3, index=code_block_10.out0)
getItemAtIndex_7 = List.GetItemAtIndex(list=getItemAtIndex_6@L2, index=code_block_10.out0)
getItemAtIndex_8 = List.GetItemAtIndex(list=getItemAtIndex_6@L2, index=code_block_10.out1)
byStartPointEndPoint_2 = Line.ByStartPointEndPoint(startPoint=getItemAtIndex_7, endPoint=getItemAtIndex_8)
split_2 = Geometry.Split(geometry=firstItem_2, other=byStartPointEndPoint_2)
perimeterCurves_2 = Surface.PerimeterCurves(surface=split_2)
startPoint_3 = Curve.StartPoint(curve=perimeterCurves_2)
firstItem_3 = List.FirstItem(list=startPoint_3@L3)
lastItem_3 = List.LastItem(list=startPoint_3@L3)
reverse_3 = List.Reverse(list=lastItem_3@L2)
combine_2 = List.Combine(comb=create_3, list1=firstItem_3, list2=reverse_3)
flatten_9 = List.Flatten(list=combine_2@L2)
join = List.Join(list0=flatten_6, list1=flatten_7, list2=flatten_8, list3=flatten_9)
count_2 = List.Count()  # unwired: list
sortByFunction_2 = List.SortByFunction(list=join, func=count_2)
groupByFunction_2 = List.GroupByFunction(list=sortByFunction_2, func=count_2)
UVParameterAtPoint = Surface.UVParameterAtPoint(surface=code_block_2, point=groupByFunction_2)
U = UV.U(uV=UVParameterAtPoint)
flatten_10 = List.Flatten(list=U@L2)
create_4 = List.Create(item0=flatten_10)
V = UV.V(uV=UVParameterAtPoint)
flatten_11 = List.Flatten(list=V@L2)
create_5 = List.Create(item0=flatten_11)
pointAtParameter = Surface.PointAtParameter(surface=flatten, u=create_4, v=create_5, lacing=Longest)
count_3 = List.Count()  # unwired: list
groupByFunction_3 = List.GroupByFunction(list=pointAtParameter@L3, func=count_3)
code_block_13 = CodeBlock { 0; 1; 2; }
getItemAtIndex_9 = List.GetItemAtIndex(list=groupByFunction_3@@L4, index=code_block_13.out0)
VARTriangular = Output(getItemAtIndex_9)
getItemAtIndex_10 = List.GetItemAtIndex(list=groupByFunction_3@@L4, index=code_block_13.out1)
VARQuadrilateral = Output(getItemAtIndex_10)
getItemAtIndex_11 = List.GetItemAtIndex(list=groupByFunction_3@@L4, index=code_block_13.out2)
VARHexagon = Output(getItemAtIndex_11)
VARShowPolygons = Input(VARShowPolygons: bool = false)
empty = List.Empty()
scopeIf = Custom[CW.ScopeIf+](VARtest=VARShowPolygons, VARtrue=groupByFunction_3, VARfalse=empty)  # A (hopefully) more robust implementation of ScopeIf. Tests a single boolean and returns a value accordingly.
byPoints_5 = Polygon.ByPoints(points=scopeIf)
python_null_2_empty = Custom[Python Null 2 Empty](VARIN=byPoints_5)  # Python Null 2 Empty
VARPolygons = Output(python_null_2_empty)
