# Dynamo custom node Join Adjacent Surfaces.dyf (Dynamo 2.1.0.7500)
# category: Synthesize.Automate.Surface
# Join Adjacent Surfaces

VARJoinOrNot = Input(VARJoinOrNot: bool = true)
VARSurfaces = Input(VARSurfaces: var[]..[])
flatten = List.Flatten(list=VARSurfaces)
empty = List.Empty()
scopeIf = Custom[CW.ScopeIf+](VARtest=VARJoinOrNot, VARtrue=flatten, VARfalse=empty)  # A (hopefully) more robust implementation of ScopeIf. Tests a single boolean and returns a value accordingly.
code_block = CodeBlock { "Surface"; }
byClassName = Custom[SP.Filter.ByClassName](VARobject=scopeIf, VARclassName=code_block)  # Filters a list of objects by the object's class name. Note that Dynamo elements belong to different classes than their Revit counterparts. Use the Object.Class node to check an object's class.
VARNormalsCheck = Input(VARNormalsCheck: bool = true)
python_script = Python(IN[0]=byClassName.VARin, IN[1]=VARNormalsCheck)
# ---------- python_script.python (122 lines) ----------
# Enable Python support and load DesignScript library
# IMPORTANT : ALL DYNAMO DESIGN SCRIPT NODES ARE AS (dg)
import clr
clr.AddReference('ProtoGeometry')
from Autodesk.DesignScript import Geometry as dg

# EXTENSION Enable ToDSType
clr.AddReference('RevitNodes')
import Revit
clr.ImportExtensions(Revit.Elements)

# Enable Revit Elements
from Revit.Elements import *

# EXTENSION Enable Geometry Conversion Methods
clr.ImportExtensions(Revit.GeometryConversion)

# Enable Revit API
clr.AddReference('RevitAPI')
from Autodesk.Revit.DB import *

# Enable DocumentManager and TransactionManager
clr.AddReference('RevitServices')
from RevitServices.Persistence import DocumentManager
from RevitServices.Transactions import TransactionManager
clr.AddReference('DynamoRevitDS')
import Dynamo 
# Enable ICollection List Translate
clr.AddReference("System")
import System.Collections.Generic
from System.Collections.Generic import List

dataEnteringNode = IN
# Use UnwrapElement(IN[0]) When Translating From Dynamo to Revit
surfaces = UnwrapElement(IN[0])
normalscheck = IN[1]

# Choose The Current Document
doc = DocumentManager.Instance.CurrentDBDocument
uidoc = DocumentManager.Instance.CurrentUIApplication.ActiveUIDocument
uiapp = DocumentManager.Instance.CurrentUIApplication
app = uiapp.Application

def tolist(obj1):
	if hasattr(obj1,'__iter__'): return obj1
	else: return [obj1]

def flatten(x):
    result = []
    for el in x:
        if hasattr(el, "__iter__") and not isinstance(el, basestring):
            result.extend(flatten(el))
        else:
            result.append(el)
    return result

def joinsurfs(surfs):
	def surf_doesinter(a,b,tollerance = 0.00001):
		if round(dg.Geometry.DistanceTo(a,b),2) < tollerance:
			return True
		else:
			return False
	crvs = flatten(tolist(surfs))
	crvGroup = [-1 for x in range(len(crvs))]
	crvGroup[0] = 0
	maxGroupNum = 1
	for i in range(len(crvs)):
		if (crvGroup[i] == -1):
			crvGroup[i] = i
		for j in range(len(crvs)):
			try:
				if i != j and surf_doesinter(crvs[i], crvs[j]):
					if (crvGroup[j] == -1):
						crvGroup[j] = crvGroup[i]
					elif (crvGroup[i] != crvGroup[j]):
						oldNum = crvGroup[j]
						for k in range(len(crvs)):
							if (crvGroup[k] == oldNum):
								crvGroup[k] = crvGroup[i]
			except:
				pass
	groups = []
	excluded = []
	for n in crvGroup:
		innercount = 0
		tmp = []
		for n2 in crvGroup:
			if n == n2 and n2 not in excluded:
				tmp.append(crvs[innercount])
			innercount += 1
		if len(tmp) == 0:
			continue
		try:
			tmp = dg.Surface.ByUnion(tmp)
			groups.append(tmp)
		except:
			try:
				tmp = dg.PolySurface.ByJoinedSurfaces(tmp)
				groups.append(tmp)
			except:
				for t in tmp:
					groups.append(t)
		excluded.append(n)
	joinedsurfs = groups
	return joinedsurfs

surfaces = joinsurfs(surfaces)

finalsurfaces = []
for s in surfaces:
	try:
		if normalscheck:
			offset = dg.Surface.Offset(s,0)
			offset.Dispose()
		finalsurfaces.append(s)
	except:
		exploded = dg.Geometry.Explode(s)
		finalsurfaces.append(exploded)
finalsurfaces = flatten(finalsurfaces)

# Assign your output to the OUT variable.
OUT = finalsurfaces
# ----------------------------------------
create = List.Create(item0=python_script, item1=byClassName.VARout)
code_block_2 = CodeBlock { false; }
clean = List.Clean(list=create, preserveIndices=code_block_2)
flatten_2 = List.Flatten(list=clean)
scopeIf_2 = Custom[CW.ScopeIf+](VARtest=VARJoinOrNot, VARtrue=flatten_2, VARfalse=flatten)
VARJoinedSurfaces = Output(scopeIf_2)
