# Dynamo custom node K-Array Points Only.dyf (Dynamo 2.6.2.15705)
# category: Synthesize.Automate.Array
# K-Array By Levels
# packages: Synthesize toolkit 12.7.3

VARByDistance = Input(VARByDistance: var[]..[] = FalseByNumber = True;)
code_block = CodeBlock { null; }
VARByDistanceJustifyEachLineSeparately = Input(VARByDistanceJustifyEachLineSeparately: var[]..[])
code_block_2 = CodeBlock { false; }
VARByDistanceForceStart = Input(VARByDistanceForceStart: var[]..[])
scopeIf = Custom[CW.ScopeIf+](VARtest=VARByDistanceJustifyEachLineSeparately, VARtrue=code_block_2, VARfalse=VARByDistanceForceStart)  # package Synthesize toolkit; A (hopefully) more robust implementation of ScopeIf. Tests a single boolean and returns a value accordingly.
join = List.Join()  # unwired: list0, list1
VAROffsetClosedLoopsRecommended = Input(VAROffsetClosedLoopsRecommended: var[]..[])
code_block_3 = CodeBlock { 0; }
eq = VAROffsetClosedLoopsRecommended == code_block_3
VARReverseArrayDirection = Input(VARReverseArrayDirection: var[]..[])
VARCurves = Input(VARCurves: var[]..[])
code_block_4 = CodeBlock { false; }
clean = List.Clean(list=VARCurves, preserveIndices=code_block_4)
flatten = List.Flatten(list=clean)
as_polycurve_bycurves = Custom[AS.[&] PolyCurve.ByCurves](VARcurves=flatten)  # package Synthesize toolkit; Create polycurves from an unordered list of curves.
reverse = Curve.Reverse(curve=as_polycurve_bycurves.VARpolyCurve)
scopeIf_2 = Custom[CW.ScopeIf+](VARtest=VARReverseArrayDirection, VARtrue=reverse, VARfalse=as_polycurve_bycurves.VARpolyCurve)
offset = Curve.Offset(distance=VAROffsetClosedLoopsRecommended)  # unwired: curve
map = List.Map(list=scopeIf_2, f_x=offset)
scopeIf_3 = Custom[CW.ScopeIf+](VARtest=eq, VARtrue=scopeIf_2, VARfalse=map)
flatten_2 = List.Flatten(list=scopeIf_3)
VARByDistanceStartOffset = Input(VARByDistanceStartOffset: var[]..[])
length = Curve.Length(curve=flatten_2)
code_block_5 = CodeBlock { 6; }
round = Math.Round(number=length, digits=code_block_5)
sub = round - VARByDistanceStartOffset
VARByDistanceDistances = Input(VARByDistanceDistances: var[]..[])
div = sub / VARByDistanceDistances
code_block_6 = CodeBlock { 1; }
add = div + code_block_6
code_block_7 = CodeBlock { 1; }
code_block_8 = CodeBlock { 0; }
eq_2 = _ == code_block_8  # unwired: x
replaceByCondition = Replace(item=add, replaceWith=code_block_7, condition=eq_2)
floor = Math.Floor(number=replaceByCondition)
sequence = Sequence(start=VARByDistanceStartOffset, amount=floor, step=VARByDistanceDistances, lacing=Longest)
pointAtSegmentLength = Curve.PointAtSegmentLength(curve=flatten_2, segmentLength=sequence)
endPoint = Curve.EndPoint(curve=flatten_2)
isNull = Object.IsNull()  # unwired: obj
replaceByCondition_2 = Replace(item=pointAtSegmentLength, replaceWith=endPoint, condition=isNull)
firstItem = List.FirstItem(list=replaceByCondition_2@L2)
code_block_9 = CodeBlock { null; }
scopeIf_4 = Custom[CW.ScopeIf+](VARtest=scopeIf, VARtrue=firstItem, VARfalse=code_block_9)
VARByDistanceForceEnd = Input(VARByDistanceForceEnd: var[]..[])
scopeIf_5 = Custom[CW.ScopeIf+](VARtest=VARByDistanceJustifyEachLineSeparately, VARtrue=code_block_2, VARfalse=VARByDistanceForceEnd)
code_block_10 = CodeBlock { null; false; }
VARByDistanceCenterJustification = Input(VARByDistanceCenterJustification: var[]..[])
code_block_11 = CodeBlock { false; }
scopeIf_6 = Custom[CW.ScopeIf+](VARtest=VARByDistance, VARtrue=code_block_11, VARfalse=VARByDistanceJustifyEachLineSeparately)
scopeIf_7 = Custom[CW.ScopeIf+](VARtest=VARByDistanceCenterJustification, VARtrue=scopeIf_6, VARfalse=code_block_11)
string_from_object = FromObject(obj=scopeIf_3)
code_block_12 = CodeBlock { "Polycurve"; }
code_block_13 = CodeBlock { true; }
contains = String.Contains(str=string_from_object, searchFor=code_block_12, ignoreCase=code_block_13)
filterByBoolMask = List.FilterByBoolMask(list=scopeIf_3, mask=contains)
byJoinedCurves = PolyCurve.ByJoinedCurves()  # unwired: curves
map_2 = List.Map(list=filterByBoolMask.out, f_x=byJoinedCurves)
create = List.Create(item0=map_2)
flatten_3 = List.Flatten(list=create)
join_2 = List.Join(list0=filterByBoolMask.in, list1=flatten_3)
code_block_14 = CodeBlock { false; }
clean_2 = List.Clean(list=join_2, preserveIndices=code_block_14)
curves = PolyCurve.Curves(polyCurve=clean_2)
code_block_15 = CodeBlock { null; false; }
scopeIf_8 = Custom[CW.ScopeIf+](VARtest=scopeIf_7, VARtrue=curves, VARfalse=code_block_15.out0)
scopeIf_9 = Custom[CW.ScopeIf+](VARtest=scopeIf_7, VARtrue=code_block_15.out0, VARfalse=scopeIf_3)
join_3 = List.Join(list0=scopeIf_8, list1=scopeIf_9)
clean_3 = List.Clean(list=join_3, preserveIndices=code_block_15.out1)
flatten_4 = List.Flatten(list=clean_3)
scopeIf_10 = Custom[CW.ScopeIf+](VARtest=scopeIf_7, VARtrue=flatten_4, VARfalse=flatten_4)
join_4 = List.Join()  # unwired: list0, list1
length_2 = Curve.Length(curve=flatten_4)
code_block_16 = CodeBlock { 6; }
round_2 = Math.Round(number=length_2, digits=code_block_16)
code_block_17 = CodeBlock { 2; }
div_2 = round_2 / code_block_17
div_3 = round_2 / VARByDistanceDistances
div_4 = div_3 / code_block_17
code_block_18 = CodeBlock { 1; }
code_block_19 = CodeBlock { 0; }
eq_3 = _ == code_block_19  # unwired: x
replaceByCondition_3 = Replace(item=div_4, replaceWith=code_block_18, condition=eq_3)
floor_2 = Math.Floor(number=replaceByCondition_3)
code_block_20 = CodeBlock { 1; }
add_2 = floor_2 + code_block_20
sequence_2 = Sequence(start=div_2, amount=add_2, step=VARByDistanceDistances, lacing=Longest)
code_block_21 = CodeBlock { -1; }
mul = sequence_2 * code_block_21
add_3 = round_2 + mul  # lacing=Longest
combine = List.Combine(comb=join_4, list1=sequence_2, list2=add_3)
sort = List.Sort(list=combine)
pointAtSegmentLength_2 = Curve.PointAtSegmentLength(curve=scopeIf_10, segmentLength=sort, lacing=Longest)
code_block_22 = CodeBlock { null; false; }
scopeIf_11 = Custom[CW.ScopeIf+](VARtest=VARByDistanceCenterJustification, VARtrue=pointAtSegmentLength_2, VARfalse=code_block_22.out0)
scopeIf_12 = Custom[CW.ScopeIf+](VARtest=VARByDistanceCenterJustification, VARtrue=code_block_22.out0, VARfalse=replaceByCondition_2)
join_5 = List.Join(list0=scopeIf_11, list1=scopeIf_12)
clean_4 = List.Clean(list=join_5, preserveIndices=code_block_22.out1)
scopeIf_13 = Custom[CW.ScopeIf+](VARtest=scopeIf_5, VARtrue=code_block_10.out0, VARfalse=clean_4)
combine_2 = List.Combine(comb=join, list1=clean_4, list2=endPoint)
scopeIf_14 = Custom[CW.ScopeIf+](VARtest=scopeIf_5, VARtrue=combine_2, VARfalse=code_block_10.out0)
join_6 = List.Join(list0=scopeIf_13, list1=scopeIf_14)
clean_5 = List.Clean(list=join_6, preserveIndices=code_block_10.out1)
combine_3 = List.Combine(comb=join, list1=scopeIf_4, list2=clean_5)
code_block_23 = CodeBlock { null; }
scopeIf_15 = Custom[CW.ScopeIf+](VARtest=scopeIf, VARtrue=combine_3, VARfalse=code_block_23)
scopeIf_16 = Custom[CW.ScopeIf+](VARtest=scopeIf, VARtrue=code_block_23, VARfalse=clean_5)
join_7 = List.Join(list0=scopeIf_15, list1=scopeIf_16)
clean_6 = List.Clean(list=join_7, preserveIndices=code_block_10.out1)
pruneDuplicates = Point.PruneDuplicates(points=clean_6)
scopeIf_17 = Custom[CW.ScopeIf+](VARtest=VARByDistance, VARtrue=code_block, VARfalse=pruneDuplicates)
flatten_5 = List.Flatten(list=scopeIf_3)
code_block_24 = CodeBlock { 0; 1; }
isClosed = Curve.IsClosed(curve=scopeIf_3)
VARByNumberNumberofItems = Input(VARByNumberNumberofItems: var[]..[])
count = List.Count(list=isClosed)
cycle = List.Cycle(list=VARByNumberNumberofItems, amount=count)
code_block_25 = CodeBlock { 1; }
add_4 = cycle + code_block_25
scopeIf_18 = Custom[CW.ScopeIf+](VARtest=isClosed, VARtrue=add_4, VARfalse=cycle)
sequence_3 = Sequence(start=code_block_24.out0, amount=scopeIf_18, step=code_block_24.out1, lacing=Longest)
VARByNumberStartRatio = Input(VARByNumberStartRatio: var[]..[])
VARByNumberEndRatio = Input(VARByNumberEndRatio: var[]..[])
remapRange = Math.RemapRange(numbers=sequence_3, newMin=VARByNumberStartRatio, newMax=VARByNumberEndRatio)
code_block_26 = CodeBlock { 0; 1; }
VARByNumberPositionJustification0to1 = Input(VARByNumberPositionJustification0to1: var[]..[])
code_block_27 = CodeBlock { 1; }
getItemAtIndex = List.GetItemAtIndex(list=remapRange@L2, index=code_block_27)
code_block_28 = CodeBlock { 0; }
getItemAtIndex_2 = List.GetItemAtIndex(list=remapRange@L2, index=code_block_28)
sub_2 = getItemAtIndex - getItemAtIndex_2
mapTo = Math.MapTo(rangeMin=code_block_26.out0, rangeMax=code_block_26.out1, inputValue=VARByNumberPositionJustification0to1, targetRangeMin=code_block_26.out0, targetRangeMax=sub_2)
add_5 = remapRange@L2 + mapTo  # lacing=Longest
code_block_29 = CodeBlock { 1; }
sub_3 = add_5 - code_block_29
gt = _ > code_block_29  # unwired: x
replaceByCondition_4 = Replace(item=add_5, replaceWith=sub_3, condition=gt)
pointAtParameter = Curve.PointAtParameter(curve=flatten_5, param=replaceByCondition_4)
pruneDuplicates_2 = Point.PruneDuplicates(points=pointAtParameter)
scopeIf_19 = Custom[CW.ScopeIf+](VARtest=VARByDistance, VARtrue=pruneDuplicates_2, VARfalse=code_block)
join_8 = List.Join(list0=scopeIf_17, list1=scopeIf_19)
code_block_30 = CodeBlock { false; }
clean_7 = List.Clean(list=join_8, preserveIndices=code_block_30)
VARPoints = Output(clean_7)
code_block_31 = CodeBlock { null; }
parameterAtPoint = Curve.ParameterAtPoint(curve=scopeIf_10, point=pruneDuplicates)
segmentLengthAtParameter = Curve.SegmentLengthAtParameter(curve=scopeIf_10, param=parameterAtPoint)
scopeIf_20 = Custom[CW.ScopeIf+](VARtest=VARByDistance, VARtrue=code_block_31, VARfalse=segmentLengthAtParameter)
parameterAtPoint_2 = Curve.ParameterAtPoint(curve=flatten_5, point=pruneDuplicates_2)
segmentLengthAtParameter_2 = Curve.SegmentLengthAtParameter(curve=flatten_5, param=parameterAtPoint_2)
scopeIf_21 = Custom[CW.ScopeIf+](VARtest=VARByDistance, VARtrue=segmentLengthAtParameter_2, VARfalse=code_block_31)
join_9 = List.Join(list0=scopeIf_20, list1=scopeIf_21)
code_block_32 = CodeBlock { false; }
clean_8 = List.Clean(list=join_9, preserveIndices=code_block_32)
VARSpaces = Output(clean_8)
count_2 = List.Count(list=as_polycurve_bycurves.VARpolyCurve)
VARNumberofPolycurves = Output(count_2)
VARExtendedPolycurves = Output(scopeIf_10)
code_block_33 = CodeBlock { 0.000001; }
extendEnd = Curve.ExtendEnd(curve=flatten_4, distance=code_block_33)
