# Dynamo custom node K-Attractor For Parameters.dyf (Dynamo 2.1.0.7500)
# category: Synthesize.Automate.K-Attractor
# K-Attractor By Selection

VARProceed = Input(VARProceed: var[]..[])
VARAttractors = Input(VARAttractors: var[]..[])
VARElementstoWorkon = Input(VARElementstoWorkon: var[]..[])
flatten = List.Flatten(list=VARElementstoWorkon)
VARListofParameterstoAttract = Input(VARListofParameterstoAttract: var[]..[])
parameterExists = Custom[CW.Element.ParameterExists](VARparam=VARListofParameterstoAttract, VARelement=flatten)  # Checks if an element contains a parameter of a given name
transpose = List.Transpose(lists=parameterExists)
allTrue = List.AllTrue(list=transpose@L2)
filterByBoolMask = List.FilterByBoolMask(list=flatten, mask=allTrue)
k_attractor_sorter = Custom[K-Attractor Sorter](VARAttractors=VARAttractors, VARElements=filterByBoolMask.in)  # K-Attractor Sorter
number = DoubleInput(0)
count = List.Count(list=k_attractor_sorter.VARGroupedandSortedElements)
number_2 = DoubleInput(1)
sequence = Sequence(start=number, amount=count, step=number_2, lacing=Longest)
getItemAtIndex = List.GetItemAtIndex(list=k_attractor_sorter.VARGroupedandSortedElements, index=sequence)
code_block = CodeBlock { null; }
scopeIf = Custom[CW.ScopeIf+](VARtest=VARProceed, VARtrue=getItemAtIndex, VARfalse=code_block)  # A (hopefully) more robust implementation of ScopeIf. Tests a single boolean and returns a value accordingly.
code_block_2 = CodeBlock { false; }
clean = List.Clean(list=scopeIf, preserveIndices=code_block_2)
flatten_2 = List.Flatten(list=clean)
uniqueItems = List.UniqueItems(list=VARListofParameterstoAttract)
scopeIf_2 = Custom[CW.ScopeIf+](VARtest=VARProceed, VARtrue=uniqueItems, VARfalse=code_block)
clean_2 = List.Clean(list=scopeIf_2, preserveIndices=code_block_2)
VARAdditive = Input(VARAdditive: var[]..[])
VARNormalize = Input(VARNormalize: var[]..[])
VARRepeatedSequenceforAllParameters = Input(VARRepeatedSequenceforAllParameters: var[]..[])
code_block_3 = CodeBlock { null; }
VARReverseNumbers = Input(VARReverseNumbers: var[]..[])
VARStartNumber = Input(VARStartNumber: var[]..[])
count_2 = List.Count(list=getItemAtIndex)
count_3 = List.Count(list=uniqueItems)
mul = count_2 * count_3
scopeIf_3 = Custom[CW.ScopeIf+](VARtest=VARRepeatedSequenceforAllParameters, VARtrue=count_2, VARfalse=mul)
VARSequenceSteps = Input(VARSequenceSteps: var[]..[])
sequence_2 = Sequence(start=VARStartNumber, amount=scopeIf_3, step=VARSequenceSteps, lacing=Longest)
reverse = List.Reverse(list=sequence_2)
scopeIf_4 = Custom[CW.ScopeIf+](VARtest=VARReverseNumbers, VARtrue=reverse, VARfalse=sequence_2)
flatten_3 = List.Flatten(list=scopeIf_4)
scopeIf_5 = Custom[CW.ScopeIf+](VARtest=VARRepeatedSequenceforAllParameters, VARtrue=code_block_3, VARfalse=flatten_3)
cycle = List.Cycle(list=flatten_3, amount=count_3)
scopeIf_6 = Custom[CW.ScopeIf+](VARtest=VARRepeatedSequenceforAllParameters, VARtrue=cycle, VARfalse=code_block_3)
create = List.Create(item0=scopeIf_5, item1=scopeIf_6)
code_block_4 = CodeBlock { false; }
clean_3 = List.Clean(list=create, preserveIndices=code_block_4)
flatten_4 = List.Flatten(list=clean_3)
VARNewMinimumNormalize = Input(VARNewMinimumNormalize: var[]..[] = True)
VARNewMaximumNormalize = Input(VARNewMaximumNormalize: var[]..[] = True)
remapRange = Math.RemapRange(numbers=flatten_4, newMin=VARNewMinimumNormalize, newMax=VARNewMaximumNormalize)
scopeIf_7 = Custom[CW.ScopeIf+](VARtest=VARNormalize, VARtrue=remapRange, VARfalse=flatten_4)
VARRounding = Input(VARRounding: var[]..[])
roundToPrecision = Custom[CW.Math.RoundToPrecision](VARdbl=scopeIf_7, VARprecision=VARRounding)  # Rounds a number to a specified precision
scopeIf_8 = Custom[CW.ScopeIf+](VARtest=VARProceed, VARtrue=roundToPrecision, VARfalse=code_block)
chop = List.Chop(list=scopeIf_8, lengths=count_2)
clean_4 = List.Clean(list=chop, preserveIndices=code_block_2)
getParameterValueByName = Element.GetParameterValueByName(element=clean, parameterName=clean_2@L1)
add = clean_4 + getParameterValueByName
scopeIf_9 = Custom[CW.ScopeIf+](VARtest=VARAdditive, VARtrue=add, VARfalse=clean_4)
flatten_5 = List.Flatten()  # unwired: list
map = List.Map(list=scopeIf_9, f_x=flatten_5)
setParameterByName = Element.SetParameterByName(element=flatten_2, parameterName=clean_2@L1, value=map@L2)
VARElementstoselect = Output(filterByBoolMask.in)
count_4 = List.Count(list=filterByBoolMask.in)
VARNumberofTotalElements = Output(count_4)
VARNumberofUniqueElements = Output(count_2)
VARValuesGenerated = Output(roundToPrecision)
sub = count_4 - count
VARNumberofRepeatedElements = Output(sub)
VARLocations = Output(k_attractor_sorter.VARLocations)
