# Dynamo custom node K-Attractor Sorter.dyf (Dynamo 2.1.0.7500)
# category: Synthesize.Automate.K-Attractor
# K-Attractor Sorter

VARElements = Input(VARElements: var[]..[])
location_of_any_element = Custom[Location Of Any Element](VARElements=VARElements)  # Location Of Any Element
code_block = CodeBlock { 2; }
normalizeDepth = List.NormalizeDepth(list=location_of_any_element.VARLocations, rank=code_block)
count = List.Count(list=normalizeDepth@L2)
code_block_2 = CodeBlock { 1; }
gt = count > code_block_2
filterByBoolMask = List.FilterByBoolMask(list=location_of_any_element.VARLocations, mask=gt)
flatten = List.Flatten(list=filterByBoolMask.in@L3)
byGeometry = BoundingBox.ByGeometry(geom=flatten@L2)
centerPoint = Custom[ZK.BoundingBox.CenterPoint](VARBoundingBox=byGeometry)  # Input Bounding Box element to get its center point. This node is little and lightweight, as it doesn't convert bounding box to geometry to get its centroid point.
mergeByBoolMask = Custom[SP.List.MergeByBoolMask](VARIn=centerPoint, VAROut=filterByBoolMask.out, VARmask=gt)  # Merge two lists by a boolean mask list. The true count in the mask should be the same as the length of the true list and vice versa for the false list.
flatten_2 = List.Flatten(list=mergeByBoolMask)
create = List.Create(item0=flatten_2)
VARAttractors = Input(VARAttractors: var[]..[])
location_of_any_element_2 = Custom[Location Of Any Element](VARElements=VARAttractors)
flatten_3 = List.Flatten(list=location_of_any_element_2.VARLocations)
matchLength = Custom[LF.List.MatchLength](VARlistLength=create, VARlist=flatten_3@L1)  # Cycle a list to match the length of the first list.
distanceTo = Geometry.DistanceTo(geometry=matchLength, other=create@L1)
flatten_4 = List.Flatten(list=distanceTo)
count_2 = List.Count(list=flatten_3)
chop = List.Chop(list=flatten_4, lengths=count_2)
minimumItem = List.MinimumItem(list=chop)
as_list_sortbykey = Custom[AS.[&] List.SortByKey](VARlist=location_of_any_element.VARElements, VARkeys=minimumItem)  # Sort a list (or lists) according to the order specified by the key list.
code_block_3 = CodeBlock { 0.0001; }
roundToPrecision = Custom[CW.Math.RoundToPrecision](VARdbl=as_list_sortbykey.VARsortedkeys, VARprecision=code_block_3)  # Rounds a number to a specified precision
indexOf = List.IndexOf(list=roundToPrecision)  # unwired: element
map = List.Map(list=roundToPrecision, f_x=indexOf)
groupByKey = List.GroupByKey(list=as_list_sortbykey.VARsortedlist, keys=map)
VARGroupedandSortedElements = Output(groupByKey.groups)
flatten_5 = List.Flatten(list=create)
as_list_sortbykey_2 = Custom[AS.[&] List.SortByKey](VARlist=flatten_5, VARkeys=minimumItem)
groupByKey_2 = List.GroupByKey(list=as_list_sortbykey_2.VARsortedlist, keys=map)
VARLocations = Output(groupByKey_2.groups)
