# Dynamo custom node K-Flatten Family.dyf (Dynamo 2.13.1.3887)
# category: Synthesize.Automate.Family
# K-Unhost Family

VARFamilyInstance = Input(VARFamilyInstance: var[]..[])
VARFamilyTemplate = Input(VARFamilyTemplate: var[]..[])
VAROverwriteParameters = Input(VAROverwriteParameters: bool = true)
VARSeparators = Input(VARSeparators: string = "_")
VARInitialHostWidth = Input(VARInitialHostWidth: double = 0)
VARForceWorkPlaneBased = Input(VARForceWorkPlaneBased: bool = false)
VARChangePlane = Input(VARChangePlane: bool = false)
VARDirectionFlip = Input(VARDirectionFlip: bool = false)
VARPosition = Input(VARPosition: int = 0)
VARRotation = Input(VARRotation: int = 0)
python_script = Python(IN[0]=VARFamilyInstance, IN[1]=VARFamilyTemplate, IN[2]=VAROverwriteParameters, IN[3]=VARSeparators, IN[4]=VARInitialHostWidth, IN[5]=VARForceWorkPlaneBased, IN[6]=VARChangePlane, IN[7]=VARDirectionFlip, IN[8]=VARPosition, IN[9]=VARRotation)  # IronPython2
# ---------- python_script.python (708 lines) ----------
# Proudly created by Karam Baki: karam@aecedx.com

# Import crl
import clr

# IMPORTANT : ALL DYNAMO DESIGN SCRIPT NODES ARE AS (dg)
clr.AddReference('ProtoGeometry')
from Autodesk.DesignScript import Geometry as dg

# Enable Revit API
clr.AddReference('RevitAPI')
from Autodesk.Revit.DB import *

# Enable ToDSType
clr.AddReference('RevitNodes')
import Revit

# Enable Geometry Conversion Methods
clr.ImportExtensions(Revit.GeometryConversion)

# Enable DocumentManager and TransactionManager
clr.AddReference('RevitServices')
from RevitServices.Persistence import DocumentManager
from RevitServices.Transactions import TransactionManager

# Enable Revit UI
clr.AddReference("RevitAPIUI")
from Autodesk.Revit.UI import TaskDialog

# Import os
clr.AddReference("System")
import System
import sys
pf_path = System.Environment.GetFolderPath(System.Environment.SpecialFolder.ProgramFilesX86)
sys.path.append('%s\IronPython 2.7\Lib' %pf_path)
import os
import re

if int(DocumentManager.Instance.CurrentUIApplication.Application.VersionNumber) < 2022:
	allSpecsNames = []
else:
	allSpecs = SpecUtils.GetAllSpecs()
	allSpecsNames = []
	for spec in allSpecs:
		allSpecsNames.append(LabelUtils.GetLabelForSpec(spec))

def getSpec(specName):
	indexOf = allSpecsNames.IndexOf(specName)
	if indexOf != -1:
		return allSpecs[indexOf]
	return None

# Family Load Options Class
class FamOpt1(IFamilyLoadOptions):
	def __init__(self):
		pass
	def OnFamilyFound(self,familyInUse, overwriteParameterValues):
		overwriteParameterValues.Value = True
		return True
	def OnSharedFamilyFound(self,familyInUse, source, overwriteParameterValues):
		overwriteParameterValues.Value = True
		return True

# Family Load Options Class - Without Overwriting Parameters
class FamOptWithout(IFamilyLoadOptions):
	def __init__(self):
		pass
	def OnFamilyFound(self,familyInUse, overwriteParameterValues):
		overwriteParameterValues.Value = False
		return True
	def OnSharedFamilyFound(self,familyInUse, source, overwriteParameterValues):
		overwriteParameterValues.Value = False
		return True

# Simple Warning Swallow Class
class WarnSwallowSimple(IFailuresPreprocessor):
	def PreprocessFailures(self, failuresAccessor):
		failuresAccessor.DeleteAllWarnings()
		return FailureProcessingResult.Continue

# Detect Upper Mid Point
def midupperpoint(doc,elem):
	doc.Regenerate()
	bbox = elem.get_BoundingBox(None)
	minp = bbox.Min.ToPoint()
	maxp = bbox.Max.ToPoint()
	fixedminp = dg.Point.ByCoordinates(minp.X,minp.Y,maxp.Z)
	midP = dg.Curve.PointAtParameter(dg.Line.ByStartPointEndPoint(maxp,fixedminp),0.5)
	return midP

# Detect Upper Mid Point
def middownerpoint(doc,elem):
	doc.Regenerate()
	bbox = elem.get_BoundingBox(None)
	minp = bbox.Min.ToPoint()
	maxp = bbox.Max.ToPoint()
	fixedmaxp = dg.Point.ByCoordinates(maxp.X,maxp.Y,minp.Z)
	midP = dg.Curve.PointAtParameter(dg.Line.ByStartPointEndPoint(fixedmaxp,minp),0.5)
	return midP

# Detect Center Mid Point
def midcenterpoint(doc,elem):
	doc.Regenerate()
	bbox = elem.get_BoundingBox(None)
	minp = bbox.Min.ToPoint()
	maxp = bbox.Max.ToPoint()
	midP = dg.Curve.PointAtParameter(dg.Line.ByStartPointEndPoint(minp,maxp),0.5)
	return midP

# Dump External Definition Create
def exdef(param_name,param_guid,param_type,uiapp):
	app = uiapp.Application
	originalfile = uiapp.Application.SharedParametersFilename
	temp_path = System.IO.Path.GetTempPath()
	temp_file = temp_path + "Karam_Temp_Shared.txt"
	open(temp_file, 'a').close()
	uiapp.Application.SharedParametersFilename = temp_file
	definition_file = app.OpenSharedParameterFile()
	try:
		definition_file.Groups.Create("Karam Group")
	except:
		pass
	definition_groups = definition_file.Groups
	for group in definition_groups:
		ops = ExternalDefinitionCreationOptions(param_name, param_type)
		ops.GUID = param_guid
		try:
			group.Definitions.Create(ops)
		except:
			pass
	exdef = list(list(definition_groups)[0].Definitions)[0]
	return exdef,originalfile,temp_file

# Simple Flatten
def flatten(x):
    result = []
    for el in x:
        if hasattr(el, "__iter__") and not isinstance(el, basestring):
            result.extend(flatten(el))
        else:
            result.append(el)
    return result

# Get Family Instance Information
def getinstanceinfo(doc,sourceinstance):
	family = sourceinstance.Symbol.Family
	familyname = family.Name
	typesids = family.GetFamilySymbolIds()
	famtypes = []
	famtypenames = []
	for id in typesids:
		ftype = doc.GetElement(id)
		famtypes.append(ftype)
		famtypenames.append(ftype.GetParameters("Type Name")[0].AsString())
	return family,familyname,famtypes,famtypenames

# Get ElementId or Value String
def bestparamvalue(famdoc,famtype,famparam):
	if famdoc == None and famtype == None:
		ParamValueString = famparam.AsElementId()
		if ParamValueString.ToString() == "-1":
			storagetype = str(famparam.StorageType)
			try:
				if storagetype == "Integer":
					ParamValueString = famparam.AsInteger()
				elif storagetype == "Double":
					ParamValueString = famparam.AsDouble()
				elif storagetype == "String":
					ParamValueString = famparam.AsString()
			except:
				ParamValueString = famparam.AsValueString()
		else:
			try:
				ParamValueString = famparam.AsValueString()
			except:
				ParamValueString = None
	else:
		ParamValueString = famtype.AsElementId(famparam)
		if ParamValueString.ToString() == "-1":
			storagetype = str(famparam.StorageType)
			try:
				if storagetype == "Integer":
					ParamValueString = famtype.AsInteger(famparam)
				elif storagetype == "Double":
					ParamValueString = famtype.AsDouble(famparam)
				elif storagetype == "String":
					ParamValueString = famtype.AsString(famparam)
			except:
				ParamValueString = famtype.AsValueString(famparam)
		else:
			try:
				if famdoc != None:
					ParamValueString = famdoc.GetElement(ParamValueString).Name
				else:
					ParamValueString = famtype.AsValueString(famparam)
			except:
				ParamValueString = famtype.AsValueString(famparam)
	return ParamValueString

# Get/Create Wanted Family Type
def getfamtype(famdoc,famtypename = None):
	alltypes = famdoc.FamilyManager.Types
	if len(list(alltypes)) == 1 or famtypename == None:
		famtype = famdoc.FamilyManager.CurrentType
	elif len(list(alltypes)) == 0 or famtypename == None:
		famtype = famdoc.FamilyManager.NewType(famtypename)
		famdoc.FamilyManager.CurrentType = famtype
	else:
		for t in alltypes:
			if t.Name == famtypename:
				famdoc.FamilyManager.CurrentType = t
				famtype = t
				break
	return famtype

# Get Batch Family Parameters Information Function
def famparaminfo(famparam,famdoc,famtype = None):
	if famtype == None:
		famtype = famdoc.FamilyManager.CurrentType
	ParamName = famparam.Definition.Name
	is_shared = famparam.IsShared
	#if ParamName == "Height":
	#	ParamName = "Height_Original"
	ParamValueString = bestparamvalue(famdoc,famtype,famparam)
	if ParamValueString == None:
		try:
			ParamValueString = famtype.AsString(famparam)
		except:
			pass
	if int(DocumentManager.Instance.CurrentUIApplication.Application.VersionNumber) < 2022:
		ParamType = famparam.Definition.ParameterType
	else:
		ParamType = famparam.Definition.GetDataType()
	BuiltinParam = famparam.Definition.BuiltInParameter
	if int(DocumentManager.Instance.CurrentUIApplication.Application.VersionNumber) < 2022:
		BuiltinGroup = famparam.Definition.ParameterGroup
	else:
		BuiltinGroup = famparam.Definition.GetGroupTypeId()
	is_instance = famparam.IsInstance
	if is_shared:
		guid = famparam.GUID
	else:
		guid = None
	formula = famparam.Formula
	if formula == None:
		is_formuladefined = False
	else:
		is_formuladefined = True
	if len(list(famparam.AssociatedParameters)):
		is_associated = True
	else:
		is_associated = False
	return famparam,ParamValueString,ParamName,ParamType,BuiltinParam,BuiltinGroup,is_instance,is_shared,guid,formula,is_formuladefined,is_associated

# Get Batch Family Parameter Information
def getparaminfo(famdoc,famtype = None):
	if famtype == None:
		famtype = famdoc.FamilyManager.CurrentType
	allparams = list(famdoc.FamilyManager.GetParameters())
	info= []
	for famparam in allparams:
		batchinfo = famparaminfo(famparam,famdoc,famtype)
		if str(batchinfo[3]) != "LoadClassification":
			info.append(batchinfo)
	tochecklater = []
	for i in info:
		if i[9] != None:
			splitted = i[9].Split(" ")
			tochecklater.append(splitted)
	tochecklater = flatten(tochecklater)
	important = []
	for i in info:
		name = i[2]
		if int(DocumentManager.Instance.CurrentUIApplication.Application.VersionNumber) < 2022:
			isMaterialSpec = i[3].ToString() == "Material"
		else:
			isMaterialSpec = LabelUtils.GetLabelForSpec(i[3]) == "Material"
		if name in tochecklater or i[7] == True or isMaterialSpec:
			important.append(True)
		else:
			important.append(False)
	newinfo = []
	count = 0
	for im in important:
		currentinfo = info[count]
		count += 1
		tmp = []
		if im:
			if currentinfo[9] == None:
				#status = "Normal Importance"
				status = True
			else:
				#status = "Delayed Importance"
				status = True
			for i in currentinfo:
				tmp.append(i)
			tmp.append(status)
		else:
			for i in currentinfo:
				tmp.append(i)
			tmp.append(False)
		newinfo.append(tmp)
	count = 0
	try: isfam_shared = famdoc.OwnerFamily.get_Parameter(BuiltInParameter.FAMILY_SHARED).AsInteger()
	except: isfam_shared = 0
	try: isfam_workplane = famdoc.OwnerFamily.get_Parameter(BuiltInParameter.FAMILY_WORK_PLANE_BASED).AsInteger()
	except: isfam_workplane = 0
	try: isfam_vertical = famdoc.OwnerFamily.get_Parameter(BuiltInParameter.FAMILY_ALWAYS_VERTICAL).AsInteger()
	except: isfam_vertical = 0
	try: isfam_cuts = famdoc.OwnerFamily.get_Parameter(BuiltInParameter.FAMILY_ALLOW_CUT_WITH_VOIDS).AsInteger()
	except: isfam_cuts = 0
	famdoc.OwnerFamily.get_Parameter(BuiltInParameter.FAMILY_SHARED).Set(0)
	return newinfo,isfam_shared,isfam_workplane,isfam_vertical,isfam_cuts

# Initial Family Instance Information
def initialop(projectdoc,sourceinstance,hostwidth):
	initialinfo = getinstanceinfo(projectdoc,sourceinstance)
	family = initialinfo[0]
	familyname = initialinfo[1]
	projectfamtypes = initialinfo[2]
	famtypenames = initialinfo[3]
	instanceparameters = sourceinstance.GetOrderedParameters()
	TransactionManager.Instance.ForceCloseTransaction()
	famdoc = projectdoc.EditFamily(family)
	trans1 = Transaction(famdoc, 'Initial Operation')
	trans1.Start()
	warnhandle = WarnSwallowSimple()
	foptions = trans1.GetFailureHandlingOptions()
	foptions.SetFailuresPreprocessor(warnhandle)
	trans1.SetFailureHandlingOptions(foptions)
	if famdoc.OwnerFamily.get_Parameter(BuiltInParameter.FAMILY_HOSTING_BEHAVIOR).AsValueString() == "Ceiling":
		isceiling = True
	else:
		isceiling = False
	if hostwidth != 0:
		try:
			all_walls = list(FilteredElementCollector(famdoc).OfCategory(BuiltInCategory.OST_Walls).WhereElementIsElementType())
			all_floors = list(FilteredElementCollector(famdoc).OfCategory(BuiltInCategory.OST_Floors).WhereElementIsElementType())
			all_roofs = list(FilteredElementCollector(famdoc).OfCategory(BuiltInCategory.OST_Roofs).WhereElementIsElementType())
			all_ceilings = list(FilteredElementCollector(famdoc).OfCategory(BuiltInCategory.OST_Ceilings).WhereElementIsElementType())
			host_types = all_walls + all_floors + all_roofs + all_ceilings
			thecompound = CompoundStructure.CreateSingleLayerCompoundStructure(MaterialFunctionAssignment.Structure,hostwidth,FilteredElementCollector(famdoc).OfClass(Material).FirstElementId())
			for host_type in host_types:
				host_type.SetCompoundStructure(thecompound)
		except:
			pass
	originalcat = famdoc.OwnerFamily.FamilyCategory.Name
	allinfos = []
	paraminfos = []
	for famtypename in famtypenames:
		famtype = getfamtype(famdoc,famtypename)
		allinfo = getparaminfo(famdoc,famtype)
		allinfos.append(allinfo)
		paraminfos.append(allinfo[0])
	trans1.Commit()
	isfam_shared = allinfos[0][1]
	isfam_workplane = allinfos[0][2]
	isfam_vertical = allinfos[0][3]
	isfam_cuts = allinfos[0][4]
	typemarks = []
	for projectfamtype in projectfamtypes:
		typemark = projectfamtype.get_Parameter(BuiltInParameter.ALL_MODEL_TYPE_MARK).AsString()
		typemarks.append(typemark)
	resultname = "K-Flattened" + separator + familyname
	tmpfamtypenames = []
	for f in famtypenames:
		if f == familyname:
			tmpfamtypenames.append(resultname)
		else:
			tmpfamtypenames.append(f)
	famtypenames = tmpfamtypenames
	return resultname,famdoc,paraminfos,isfam_shared,isfam_workplane,isfam_vertical,isfam_cuts,originalcat,famtypenames,typemarks,isceiling

# Create New Family
def createfamily(fam_path,doc,uiapp,famname,famcategory,isShared,isWorkplane,isVertical,isCuts,paraminfos,famtypenames):
	save_path = '%s%s.rfa' % (temp_path, re.sub(r'[\\/*?:"<>|]',"",famname))
	famdoc = doc.Application.NewFamilyDocument(fam_path)
	try:
		TransactionManager.Instance.ForceCloseTransaction()
		trans1 = Transaction(famdoc, 'New ' + famname + ' Family')
		trans1.Start()
		warnhandle = WarnSwallowSimple()
		foptions = trans1.GetFailureHandlingOptions()
		foptions.SetFailuresPreprocessor(warnhandle)
		trans1.SetFailureHandlingOptions(foptions)
		fam_cat = famdoc.Settings.Categories.get_Item(famcategory)
		famdoc.OwnerFamily.FamilyCategory = fam_cat
		bigcount = 0
		for famtypename in famtypenames:
			paraminfo = paraminfos[bigcount]
			bigcount += 1
			try:
				famtype = famdoc.FamilyManager.NewType(famtypename)
				famdoc.FamilyManager.CurrentType = famtype
			except:
				pass
			for p in paraminfo:
				try:
					instatus = p[6]
					if p[7] == True:
						externaldefOP = exdef(p[2],p[8],p[3],uiapp)
						externaldef = externaldefOP[0]
						try:
							freshparam = famdoc.FamilyManager.AddParameter(externaldef,p[5],instatus)
						except:
							pass
						uiapp.Application.SharedParametersFilename = externaldefOP[1]
						os.remove(externaldefOP[2])
					else:
						freshparam = famdoc.FamilyManager.AddParameter(p[2],p[5],p[3],instatus)
				except:
					pass
		if isShared == True:
			try:famdoc.OwnerFamily.get_Parameter(BuiltInParameter.FAMILY_SHARED).Set(1)
			except:pass
		else:
			try:famdoc.OwnerFamily.get_Parameter(BuiltInParameter.FAMILY_SHARED).Set(0)
			except:pass
		if isWorkplane == True:
			try:famdoc.OwnerFamily.get_Parameter(BuiltInParameter.FAMILY_WORK_PLANE_BASED).Set(1)
			except:pass
		else:
			try:famdoc.OwnerFamily.get_Parameter(BuiltInParameter.FAMILY_WORK_PLANE_BASED).Set(0)
			except:pass
		if isVertical == True:
			try:famdoc.OwnerFamily.get_Parameter(BuiltInParameter.FAMILY_ALWAYS_VERTICAL).Set(1)
			except:pass
		else:
			try:famdoc.OwnerFamily.get_Parameter(BuiltInParameter.FAMILY_ALWAYS_VERTICAL).Set(0)
			except:pass
		if isCuts == True:
			try:famdoc.OwnerFamily.get_Parameter(BuiltInParameter.FAMILY_ALLOW_CUT_WITH_VOIDS).Set(1)
			except:pass
		else:
			try:famdoc.OwnerFamily.get_Parameter(BuiltInParameter.FAMILY_ALLOW_CUT_WITH_VOIDS).Set(0)
			except:pass
		trans1.Commit()
		famdoc.SaveAs(save_path, SaveAsOpt)
		loaded = famdoc
	except:
		try:
			trans1.Commit()
		except:
			pass
		TransactionManager.Instance.ForceCloseTransaction()
		try:famdoc.Close(False)
		except:pass
		try:doc.Close(False)
		except:pass
		try:System.IO.File.Delete(save_path)
		except:pass
		loaded = None
	return loaded,save_path

def famrotate(doc,symbol1,switchplane = False,flippedinstance = False,position = 0,direction = 0):
	if direction == 0:
		dir_ref = XYZ(1,0,0)
	elif direction == 1:
		dir_ref = XYZ(0,0,1)
	elif direction == 2:
		dir_ref = XYZ(-1,0,0)
	elif direction == 3:
		dir_ref = XYZ(0,0,-1)
	refplanes = list(FilteredElementCollector(doc).OfClass(ReferencePlane).WhereElementIsNotElementType())
	switched = True
	for refplane in refplanes:
		if refplane.get_Parameter(BuiltInParameter.DATUM_PLANE_DEFINES_ORIGIN).AsInteger() == 1:
			if switchplane and switched == False:
				switched = True
				continue
			elif refplane.Name != "Reference Plane":
				break
			else:
				refplane = None
	newinstace = doc.FamilyCreate.NewFamilyInstance(Reference(refplane), XYZ.Zero, dir_ref, symbol1)
	if flippedinstance:
		newinstace.IsWorkPlaneFlipped = True
	if position == 0:
		pt = midupperpoint(doc,newinstace).ToXyz()
		currentpt = newinstace.Location.Point
		newpt = XYZ(currentpt.X,currentpt.Y,pt.Z)
		newinstace.Location.Point = newpt
	elif position == 1:
		pt = middownerpoint(doc,newinstace).ToXyz()
		currentpt = newinstace.Location.Point
		newpt = XYZ(currentpt.X,currentpt.Y,pt.Z)
		newinstace.Location.Point = newpt
	elif position == 2:
		pt = midcenterpoint(doc,newinstace).ToXyz()
		currentpt = newinstace.Location.Point
		newpt = XYZ(currentpt.X,currentpt.Y,pt.Z)
		newinstace.Location.Point = newpt
	return newinstace

# Load Family
def loadOP(famdoc,doc,save_path,famtypenames,paraminfos,initial,isceiling,switchplane,flippedinstance,position,direction):
	try:
		if famdoc != None and doc != None:
			loaded = famdoc.LoadFamily(doc,FamOpt1())
			symbols = loaded.GetFamilySymbolIds().GetEnumerator()
			symbol1s = []
			for s in symbols:
				symbol1s.append(doc.GetElement(s))
			TransactionManager.Instance.ForceCloseTransaction()
			trans1 = Transaction(doc, 'Placing Family')
			trans1.Start()
			warnhandle = WarnSwallowSimple()
			foptions = trans1.GetFailureHandlingOptions()
			foptions.SetFailuresPreprocessor(warnhandle)
			trans1.SetFailureHandlingOptions(foptions)
			fam_cat = doc.OwnerFamily.FamilyCategory
			bigcount = 0
			allnum = len(symbol1s)
			if forceworkplane == True and initial == "Semi" and isceiling:
				try:doc.OwnerFamily.get_Parameter(BuiltInParameter.FAMILY_WORK_PLANE_BASED).Set(1)
				except:pass
			if forceworkplane == True and initial == "Last":
				try:doc.OwnerFamily.get_Parameter(BuiltInParameter.FAMILY_ALWAYS_VERTICAL).Set(0)
				except:pass
			newlyplaced = False
			for symbol1 in symbol1s:
				famtypename = famtypenames[bigcount]
				paraminfo = paraminfos[bigcount]
				if not symbol1.IsActive: symbol1.Activate()
				current_type = getfamtype(doc,famtypename)
				try:
					if initial == "Last":
						newinstace = famrotate(doc,symbol1,switchplane,flippedinstance,position,direction)
					else:
						newinstace = doc.FamilyCreate.NewFamilyInstance(XYZ.Zero, symbol1, Structure.StructuralType.NonStructural)
					newlyplaced = True
				except:
					try:
						firstlevel = doc.GetElement(FilteredElementCollector(doc).OfCategory(BuiltInCategory.OST_Levels).WhereElementIsNotElementType().FirstElementId())
						newinstace = doc.FamilyCreate.NewFamilyInstance(XYZ.Zero, symbol1, firstlevel, Structure.StructuralType.NonStructural)
					except:
						newinstace = doc.GetElement(FilteredElementCollector(doc).OfCategoryId(symbol1.Category.Id).WhereElementIsNotElementType().FirstElementId())
					newlyplaced = True
				famtypeparams = list(symbol1.GetOrderedParameters()) + list(newinstace.GetOrderedParameters())
				allparams = list(doc.FamilyManager.GetParameters())
				for elemparm in famtypeparams:
					for famparam in allparams:
						if elemparm.Definition.Name == famparam.Definition.Name:
							for p in paraminfo:
								if p[2] == famparam.Definition.Name:
									if int(DocumentManager.Instance.CurrentUIApplication.Application.VersionNumber) < 2022:
										isMaterialSpec = p[3].ToString() == "Material"
									else:
										isMaterialSpec = LabelUtils.GetLabelForSpec(p[3]) == "Material"
									if isMaterialSpec:
										mat_fec = FilteredElementCollector(doc).OfClass(Material)
										for m in mat_fec:
											if m.Name.lower() == str(p[1]).lower():
												doc.FamilyManager.Set(famparam,m.Id)
									else:
										try:
											doc.FamilyManager.Set(famparam,p[1])
										except:
											try:
												doc.FamilyManager.SetValueString(famparam,p[1])
											except:
												pass
									try:
										if p[10]:
											doc.FamilyManager.SetFormula(famparam,p[9])
									except:
										pass
							try:
								doc.FamilyManager.AssociateElementParameterToFamilyParameter(elemparm,famparam)
							except:
								pass
				if bigcount != (allnum - 1):
					doc.Delete(newinstace.Id)
				bigcount += 1
			if newlyplaced and initial == "Semi" and isceiling:
				newinstace.Location.Point = XYZ(0,0,0)
			if newlyplaced and initial == "Last" and isceiling:
				newinstace.IsWorkPlaneFlipped = True
			trans1.Commit()
			famdoc.Close(False)
			if save_path != None:
				System.IO.File.Delete(save_path)
			return "Loaded"
		else:
			return "ERROR"
	except:
		try:
			trans1.Commit()
		except:
			pass
		TransactionManager.Instance.ForceCloseTransaction()
		try:famdoc.Close(False)
		except:pass
		if save_path != None:
			System.IO.File.Delete(save_path)
		return "ERROR"

# Family Saving Options
SaveAsOpt = SaveAsOptions()
SaveAsOpt.OverwriteExistingFile = True
temp_path = System.IO.Path.GetTempPath()

# Initial Family Instance Info
sourceinstance = UnwrapElement(IN[0])
fam_path = IN[1]
overwriteparameters = IN[2]
separator = IN[3]
hostwidth = IN[4]
forceworkplane = IN[5]
switchplane = IN[6]
flippedinstance = IN[7]
position = IN[8]
direction = IN[9]

# Project Document and UI
projectdoc = DocumentManager.Instance.CurrentDBDocument
uiapp = DocumentManager.Instance.CurrentUIApplication

# Convert Host Width to Internal Units
if int(DocumentManager.Instance.CurrentUIApplication.Application.VersionNumber) < 2021:
	hostwidth = UnitUtils.ConvertToInternalUnits(hostwidth,projectdoc.GetUnits().GetFormatOptions(UnitType.UT_Length).DisplayUnits)
else:
	hostwidth = UnitUtils.ConvertToInternalUnits(hostwidth,projectdoc.GetUnits().GetFormatOptions(SpecTypeId.Length).GetUnitTypeId())

try:
	# Getting Info From Initial Family
	initialOP = initialop(projectdoc,sourceinstance,hostwidth)
	
	# Familiy is Writable
	familywritable = True
except:
	# Familiy is Not Writable
	familywritable = False
	
	# Show Message
	OUT = TaskDialog.Show("AECedx - Karam", "Please Close The Opened Family")

# Check if Family is Writable
if familywritable:
	# Variables
	resultname = initialOP[0]
	initialfamdoc = initialOP[1]
	paraminfos = initialOP[2]
	isfam_shared = initialOP[3]
	isfam_workplane = initialOP[4]
	isfam_vertical = initialOP[5]
	isfam_cuts = initialOP[6]
	originalcat = initialOP[7]
	famtypenames = initialOP[8]
	typemarks = initialOP[9]
	isceiling = initialOP[10]
	
	# Check If Forced  Workplane
	if forceworkplane:
		isfam_workplane = True
	
	# Creating Semi Family
	semifamilyOP = createfamily(fam_path,initialfamdoc,uiapp,"TMP_" + resultname,originalcat,False,True,False,False,paraminfos,famtypenames)
	semifamilydoc = semifamilyOP[0]
	semilfamilysavepath = semifamilyOP[1]

	# Load Initial to Semi Family
	loadOP(initialfamdoc,semifamilydoc,None,famtypenames,paraminfos,"Semi",isceiling,False,False,0,0)

	# Creating Final Family
	finalfamilyOP = createfamily(fam_path,initialfamdoc,uiapp,resultname,originalcat,isfam_shared,isfam_workplane,isfam_vertical,isfam_cuts,paraminfos,famtypenames)
	finalfamilydoc = finalfamilyOP[0]
	finalfamilysavepath = finalfamilyOP[1]
	
	# Load Semi to Final Family
	loadOP(semifamilydoc,finalfamilydoc,semilfamilysavepath,famtypenames,paraminfos,"Last",isceiling,switchplane,flippedinstance,position,direction)
	
	# Load Final Family to Project and Close It Then Delete It from TEMP and Close Initial Family
	if overwriteparameters:
		finalfamily = finalfamilydoc.LoadFamily(projectdoc,FamOpt1())
	else:
		finalfamily = finalfamilydoc.LoadFamily(projectdoc,FamOptWithout())
	finalfamilydoc.Close(False)
	System.IO.File.Delete(finalfamilysavepath)

	# Restore Missing Type Mark
	restore = False
	for typemark in typemarks:
		if typemark != None:
			restore = True
			break
	if restore:
		TransactionManager.Instance.ForceCloseTransaction()
		trans1 = Transaction(projectdoc, 'Restoring Type Mark')
		trans1.Start()
		warnhandle = WarnSwallowSimple()
		foptions = trans1.GetFailureHandlingOptions()
		foptions.SetFailuresPreprocessor(warnhandle)
		trans1.SetFailureHandlingOptions(foptions)
		finaltypes = finalfamily.GetFamilySymbolIds().GetEnumerator()
		count = 0
		for finaltype in finaltypes:
			try:
				typemark = typemarks[count]
				if typemark != None:
					projectdoc.GetElement(finaltype).get_Parameter(BuiltInParameter.ALL_MODEL_TYPE_MARK).Set(typemark)
			except:
				pass
			count += 1
		trans1.Commit()

	# Result Family
	OUT = finalfamily
# ----------------------------------------
VAROutput = Output(python_script)
