# Dynamo custom node K-Interference Check.dyf (Dynamo 2.1.0.7500)
# category: Synthesize.Automate.Clash Detection
# K-Interference Check

code_block = CodeBlock { "<tr>"; "<td>"; "</td>"; ""; }
replace = String.Replace(searchFor=code_block.out0, replaceWith=code_block.out3)  # unwired: str
replace_2 = String.Replace(searchFor=code_block.out1, replaceWith=code_block.out3)  # unwired: str
replace_3 = String.Replace(searchFor=code_block.out2, replaceWith=code_block.out3)  # unwired: str
compose = ComposeFunctions(func0=replace, func1=replace_2, func2=replace_3)  # "Function.Compose"
VARReport = Input(VARReport: var[]..[])
readText = FileSystem.ReadText(file=VARReport)
code_block_2 = CodeBlock { "<b>"; }
split = String.Split(str=readText, separator0=code_block_2)
code_block_3 = CodeBlock(a=split) { a[3]; }
code_block_4 = CodeBlock { "</tr>"; }
split_2 = String.Split(str=code_block_3, separator0=code_block_4)
dropFirstLast = Custom[SP.List.DropFirstLast](VARlist=split_2)  # Removes the first and last items from the list
apply = ApplyFunction(func=compose, arg1=dropFirstLast.VARlist)  # "Function.Apply"
trimWhitespace = String.TrimWhitespace(str=apply)
code_block_5 = CodeBlock { " : "; }
split_3 = String.Split(str=trimWhitespace, separator0=code_block_5)
code_block_6 = CodeBlock { 3; }
getItemAtIndex = List.GetItemAtIndex(list=split_3@L2, index=code_block_6)
code_block_7 = CodeBlock { 0; 3; }
remove = String.Remove(str=getItemAtIndex, startIndex=code_block_7.out0, count=code_block_7.out1)
code_block_8 = CodeBlock { " "; }
indexOf = String.IndexOf(str=remove, searchFor=code_block_8)
remove_2 = String.Remove(str=remove, startIndex=code_block_7.out0, count=indexOf)
trimWhitespace_2 = String.TrimWhitespace(str=remove_2)
code_block_9 = CodeBlock { ".rvt"; }
contains = String.Contains(str=trimWhitespace_2, searchFor=code_block_9)
firstItem = List.FirstItem(list=contains)
code_block_10 = CodeBlock { ": id"; }
split_4 = String.Split(str=readText, separator0=code_block_10)
trimWhitespace_3 = String.TrimWhitespace(str=split_4)
code_block_11 = CodeBlock { 1; }
dropItems = List.DropItems(list=trimWhitespace_3, amount=code_block_11)
code_block_12 = CodeBlock { " "; 0; }
indexOf_2 = String.IndexOf(str=dropItems, searchFor=code_block_12.out0)
substring = String.Substring(str=dropItems, startIndex=code_block_12.out1, length=indexOf_2)
code_block_13 = CodeBlock { 2; }
chop = List.Chop(list=substring, lengths=code_block_13)
toNumber = String.ToNumber(str=chop)
simple_byelement_id_selection = Custom[Simple ByElement Id Selection](VARId=toNumber)  # Simple ByElement Id Selection
code_block_14 = CodeBlock { 1; }
lastItem = List.LastItem(list=toNumber@L2)
empty = List.Empty()
scopeIf = Custom[CW.ScopeIf+](VARtest=firstItem, VARtrue=lastItem, VARfalse=empty)  # A (hopefully) more robust implementation of ScopeIf. Tests a single boolean and returns a value accordingly.
al_get_documents = Custom[AL.Get Documents]()  # Queries all linked Revit files and retrieves their Name, LinkInstance and Document properties.
code_block_15 = CodeBlock { "NOTLINKED"; }
scopeIf_2 = Custom[CW.ScopeIf+](VARtest=firstItem, VARtrue=trimWhitespace_2, VARfalse=code_block_15)
firstItem_2 = List.FirstItem(list=scopeIf_2)
turnIntoList = Custom[CW.TurnIntoList](VARunknownItem=firstItem_2)  # Turns an element (or a nested list) into a flat list
code_block_16 = CodeBlock { " : "; }
split_5 = String.Split(str=al_get_documents.VARLinkName, separator0=code_block_16)
firstItem_3 = List.FirstItem(list=split_5@L2)
eq = turnIntoList == firstItem_3  # lacing=Longest
filterByBoolMask = List.FilterByBoolMask(list=al_get_documents.VARLinkDoc, mask=eq)
python_script = Python(IN[0]=scopeIf, IN[1]=filterByBoolMask.in)
# ---------- python_script.python (15 lines) ----------
import clr

clr.AddReference("RevitAPI")
import Autodesk
from Autodesk.Revit.DB import *

id1 = IN[0]
LinkedDoc = UnwrapElement(IN[1])
result = []


#Assign your output to the OUT variable.
for each in id1:
	result.append(LinkedDoc[0].GetElement(ElementId(each)))
OUT = result
# ----------------------------------------
scopeIf_3 = Custom[CW.ScopeIf+](VARtest=firstItem, VARtrue=python_script, VARfalse=code_block_15)
turnIntoList_2 = Custom[CW.TurnIntoList](VARunknownItem=scopeIf_3)
replaceItemAtIndex = Custom[CW.List.ReplaceItemAtIndex+](VARseq=simple_byelement_id_selection@L2, VARindex=code_block_14, VARreplacement=turnIntoList_2, lacing=Longest)  # Replaces the item at a given index (or list of indices) of a list by another item
scopeIf_4 = Custom[CW.ScopeIf+](VARtest=firstItem, VARtrue=replaceItemAtIndex, VARfalse=simple_byelement_id_selection)
isNull = Object.IsNull(obj=scopeIf_4@L2)
anyTrue = Custom[CW.List.AnyTrue](VARseq=isNull@L2)  # Returns true if any item in a list of booleans is true.
anyTrue_2 = Custom[CW.List.AnyTrue](VARseq=anyTrue)
empty_2 = List.Empty()
code_block_17 = CodeBlock { " - "; }
join = String.Join(separator=code_block_17)  # unwired: string0, string1
empty_3 = List.Empty()
scopeIf_5 = Custom[CW.ScopeIf+](VARtest=anyTrue_2, VARtrue=empty_3, VARfalse=scopeIf_4)
getCategory = Element.GetCategory(element=scopeIf_5)
firstItem_4 = List.FirstItem(list=getCategory@L2)
string_from_object = FromObject(obj=firstItem_4)
code_block_18 = CodeBlock { "Linked "; }
lastItem_2 = List.LastItem(list=getCategory@L2)
string_from_object_2 = FromObject(obj=lastItem_2)
code_block_19 = CodeBlock(a=code_block_18, b=string_from_object_2) { a+b; }
scopeIf_6 = Custom[CW.ScopeIf+](VARtest=firstItem, VARtrue=code_block_19, VARfalse=trimWhitespace_2)
flatten = List.Flatten(list=scopeIf_6)
combine = List.Combine(comb=join, list1=string_from_object, list2=flatten)
scopeIf_7 = Custom[CW.ScopeIf+](VARtest=anyTrue_2, VARtrue=empty_2, VARfalse=combine)
VARClashCategories = Output(scopeIf_7)
scopeIf_8 = Custom[CW.ScopeIf+](VARtest=anyTrue_2, VARtrue=empty_2, VARfalse=scopeIf_4)
VARAffectedElements = Output(scopeIf_8)
uniqueItems = List.UniqueItems(list=combine)
scopeIf_9 = Custom[CW.ScopeIf+](VARtest=anyTrue_2, VARtrue=empty_2, VARfalse=uniqueItems)
VARUniqueCases = Output(scopeIf_9)
count = List.Count(list=combine)
turnIntoList_3 = Custom[CW.TurnIntoList](VARunknownItem=count)
scopeIf_10 = Custom[CW.ScopeIf+](VARtest=anyTrue_2, VARtrue=empty_2, VARfalse=turnIntoList_3)
VARNumberofClashes = Output(scopeIf_10)
scopeIf_11 = Custom[CW.ScopeIf+](VARtest=anyTrue_2, VARtrue=empty_2, VARfalse=turnIntoList)
VARLinkName = Output(scopeIf_11)
filterByBoolMask_2 = List.FilterByBoolMask(list=al_get_documents.VARLinkInstance, mask=eq)
python_script_2 = Python(IN[0]=filterByBoolMask_2.in, IN[1]=code_block_15)
# ---------- python_script_2.python (14 lines) ----------
import clr
clr.AddReference('ProtoGeometry')
from Autodesk.DesignScript.Geometry import *
#The inputs to this node will be stored as a list in the IN variables.
inside = IN[0]
result = []
reportstr = IN[1]

if len(inside) == 0:
	result.append(reportstr)
else:
	result = inside
#Assign your output to the OUT variable.
OUT = result
# ----------------------------------------
scopeIf_12 = Custom[CW.ScopeIf+](VARtest=anyTrue_2, VARtrue=empty_2, VARfalse=python_script_2)
VARLinkInstance = Output(scopeIf_12)
scopeIf_13 = Custom[CW.ScopeIf+](VARtest=anyTrue_2, VARtrue=empty_2, VARfalse=turnIntoList_2)
VARLinkElements = Output(scopeIf_13)
VARLinkNameChecking = Output(turnIntoList)
