# Dynamo custom node K-Join All In One By Interference Check File.dyf (Dynamo 2.1.0.7500)
# category: Synthesize.Automate.Join
# K-Join All In One

VARSwitchJoinOrderofAlreadyJoinedElement = Input(VARSwitchJoinOrderofAlreadyJoinedElements: var[]..[])
VARConsiderVolumetricRuleForJoining = Input(VARConsiderVolumetricRuleForJoining: var[]..[])
VARStartJoiningNewElements = Input(VARStartJoiningNewElements: var[]..[])
VARSwitchJoinOrderForNewelyJoinedElement = Input(VARSwitchJoinOrderForNewelyJoinedElements: var[]..[])
VARCleanUpAllTheJoiningWarnings = Input(VARCleanUpAllTheJoiningWarnings: var[]..[])
VARCutMode = Input(VARCutMode: var[]..[])
VARUnjoinMode = Input(VARUnjoinMode: var[]..[])
VARAvoidWarnings = Input(VARAvoidWarnings: var[]..[])
VARInterferenceCheckReport = Input(VARInterferenceCheckReport: var[]..[])
python_script = Python(IN[0]=VARSwitchJoinOrderofAlreadyJoinedElement, IN[1]=VARConsiderVolumetricRuleForJoining, IN[2]=VARStartJoiningNewElements, IN[3]=VARSwitchJoinOrderForNewelyJoinedElement, IN[4]=VARCleanUpAllTheJoiningWarnings, IN[5]=VARCutMode, IN[6]=VARUnjoinMode, IN[7]=VARAvoidWarnings, IN[8]=VARInterferenceCheckReport)
# ---------- python_script.python (415 lines) ----------
# Created By Karam Baki : karam@aecedx.com
# Parsing Technique Created By Dimitar Venkov
# Enable Python support and load DesignScript library
# IMPORTANT : ALL DYNAMO DESIGN SCRIPT NODES ARE AS (dg)
import clr
import math
clr.AddReference('ProtoGeometry')
from Autodesk.DesignScript import Geometry as dg

# EXTENSION Enable ToDSType
clr.AddReference('RevitNodes')
import Revit
clr.ImportExtensions(Revit.Elements)

import System
pf_path = System.Environment.GetFolderPath(System.Environment.SpecialFolder.ProgramFilesX86)
import sys
sys.path.append("%s\IronPython 2.7\Lib" %pf_path)

from sgmllib import SGMLParser
from collections import Counter

# Enable Revit Elements
from Revit.Elements import *

# EXTENSION Enable Geometry Conversion Methods
clr.ImportExtensions(Revit.GeometryConversion)

# Enable Revit API
clr.AddReference('RevitAPI')
from Autodesk.Revit.DB import *

# Enable DocumentManager and TransactionManager
clr.AddReference('RevitServices')
from RevitServices.Persistence import DocumentManager
from RevitServices.Transactions import TransactionManager

# Enable ICollection List Translate
clr.AddReference("System")
import System.Collections.Generic
from System.Collections.Generic import List
from itertools import compress
from itertools import combinations

doc = DocumentManager.Instance.CurrentDBDocument
uidoc = DocumentManager.Instance.CurrentUIApplication.ActiveUIDocument
uiapp = DocumentManager.Instance.CurrentUIApplication
app = uiapp.Application

class WarnSwallowSimple(IFailuresPreprocessor):
	def PreprocessFailures(self, failuresAccessor):
		failuresAccessor.DeleteAllWarnings()
		return FailureProcessingResult.Continue

class WarnSwallow(IFailuresPreprocessor):
	def PreprocessFailures(self, failuresAccessor):
		fmas = failuresAccessor.GetFailureMessages()
		if len(fmas) == 0:
			self.__warn = []
			return FailureProcessingResult.Continue
		else:
			probs = []
			isgood = True
			for fma in fmas:
				sev = str(fma.GetSeverity())
				fails = list(fma.GetFailingElementIds())
				felems = []
				for f in fails:
					felems.append(doc.GetElement(f))
				if str(sev) == "Warning": 
					failuresAccessor.ResolveFailure(fma)
					failuresAccessor.DeleteWarning(fma)
				else:
					isgood = False
					probs.append(felems) 
				self.__warn = probs
		if isgood:
			return FailureProcessingResult.ProceedWithCommit
		else:
			return FailureProcessingResult.ProceedWithRollBack 

	@property
	def warn(self):
		return(self.__warn)

def joinop(trans,notjoined,unjoinmode = False,simple = False):
	if len(notjoined) > 0:
		trans.Start()
		if simple:
			warnhandle = WarnSwallowSimple()
		else:
			warnhandle = WarnSwallow()
		foptions = trans.GetFailureHandlingOptions()
		foptions.SetFailuresPreprocessor(warnhandle)
		if simple == False:
			foptions.SetClearAfterRollback(True)
		trans.SetFailureHandlingOptions(foptions)
		count = 0
		subtran = SubTransaction(doc)
		while (count < len(notjoined)):
			try:
				subtran.Start()
				if unjoinmode:
					JoinGeometryUtils.UnjoinGeometry(doc, notjoined[count][0], notjoined[count][1])
				else:
					if cutelems == False:
						JoinGeometryUtils.JoinGeometry(doc, notjoined[count][0], notjoined[count][1])
						if SwitchNewJoined == True:
							JoinGeometryUtils.SwitchJoinOrder(doc, notjoined[count][0], notjoined[count][1])
					else:
						if SwitchNewJoined == True:
							notjoined[count].reverse()
						try:
							InstanceVoidCutUtils.AddInstanceVoidCut(doc, notjoined[count][0], notjoined[count][1])
						except:
							try:
								SolidSolidCutUtils.AddCutBetweenSolids(doc, notjoined[count][0], notjoined[count][1], False)
							except:
								pass
				count = count + 1
				subtran.Commit()
			except:
				subtran.RollBack()
				count = count +1
		trans.Commit()
		if simple == False:
			return warnhandle.warn
		else:
			return []
	else:
		return []

def removefrompairs(probs,notjoined):
	goodnotjoined = notjoined
	if len(probs) != 0:
		goodnotjoined = []
		notjoinedids = []
		for pair in notjoined:
			tmp = []
			for p in pair:
				tmp.append(p.Id)
			notjoinedids.append(tmp)
		problems = flatten(probs)
		dangerpairs = []
		for prob in problems:
			dangercount = 0
			for eachpair in notjoinedids:	
				if prob.Id in eachpair:
					dangerpairs.append(dangercount)
				dangercount += 1
		goodcount = 0
		for pair in notjoined:
			if goodcount not in dangerpairs:
				goodnotjoined.append(pair)
			goodcount += 1
	return goodnotjoined
	
def masterjoinop(trans,notjoined,unjoinmode = False,simple = False):
	probs = joinop(trans,notjoined,unjoinmode,simple)
	if simple == False:
		notjoined = removefrompairs(probs,notjoined)
		probs = joinop(trans,notjoined,unjoinmode)
		notjoined = removefrompairs(probs,notjoined)
		if len(notjoined) != 0:
			hosts = []
			probs = flatten(probs)
			for pro in probs:
				try:
					host = pro.GetHostIds()
					for h in host:
						hosts.append(doc.GetElement(h))
				except:
					pass
			notjoined = removefrompairs(hosts,notjoined)
			probs = joinop(trans,notjoined,unjoinmode)
			if len(probs) > 0:
				probids = []
				probs = flatten(probs)
				for p in probs:
					probids.append(str(p.Id))
				return probids
		else:
			return True
	else:
		return True

def flatten(x):
    result = []
    for el in x:
        if hasattr(el, "__iter__") and not isinstance(el, basestring):
            result.extend(flatten(el))
        else:
            result.append(el)
    return result

SwitchAlreadyJoined = UnwrapElement(IN[0])
ConsiderVolume = UnwrapElement(IN[1])
JoinNew = UnwrapElement(IN[2])
SwitchNewJoined = UnwrapElement(IN[3])
CleanUpAllWarn = UnwrapElement(IN[4])
cutelems = IN[5]
unjoinmode = IN[6]
avoidwarnings = IN[7]

if avoidwarnings:
	simple = False
else:
	simple = True

if unjoinmode:
	simple = True

class ReportParser(SGMLParser):
	def __init__(self, verbose=0):
		SGMLParser.__init__(self, verbose)
		self.data1 = []
		self.temp_data = []
	def handle_data(self, data):
		if data != "\n" and data not in known_errors:
			self.temp_data.append(data)
	def unknown_starttag(self, tag, attrs):
		if tag == "tr":
			self.data1.append(self.temp_data)
			self.temp_data = []

interference_cats = {"Structural Columns", "Air Terminals", "Assemblies", "Cable Tray Fittings", "Cable Tray Runs", "Cable Trays", "Casework", "Ceilings", "Columns", "Conduit Fittings", "Conduit Runs", "Conduits", "Curtain Panels", "Curtain Systems", "Curtain Wall Mullions","Doors", "Ducts", "Duct Accessories", "Duct Fittings", "Duct Insulations", "Duct Linings", "Duct Placeholders", "Duct Systems", "Electrical Circuits", "Electrical Equipment", "Electrical Fixtures", "Fabrication Parts", "Flex Ducts", "Flex Pipes", "Floors", "Furniture", "Furniture Systems", "Generic Models", "Gutters", "Lighting Devices", "Lighting Fixtures", "Mass Floors", "Mass", "Mechanical Equipment", "Pads", "Parts", "Pipe Accessories", "Pipe Fittings", "Pipe Insulations", "Pipe Placeholders", "Pipes", "Piping Systems",  "Plumbing Fixtures", "Railings", "Ramps", "Roofs", "Roof Soffits", "Shaft Openings", "Slab Edges", "Specialty Equipment", "Sprinklers", "Stairs", "Structural Connections", "Structural Foundations", "Structural Framing", "Structural Trusses", "Wall Sweeps", "Walls", "Windows", "Wires"}

def getElement(i):
	try: return doc.GetElement(ElementId(i)).ToDSType(1)
	except: return i

def fetchCat(items, interference_cats=interference_cats):
	for i in items:
		if i in interference_cats:
			return i



report1, fetch_elements = IN[8], True

if fetch_elements:	#imports moved here to be able to process externally
	clr.AddReference("RevitServices")
	from RevitServices.Persistence import DocumentManager
	doc = DocumentManager.Instance.CurrentDBDocument
	clr.AddReference("RevitAPI")
	from Autodesk.Revit.DB import ElementId
	clr.AddReference('RevitNodes')
	import Revit
	clr.ImportExtensions(Revit.Elements)

known_errors = {"  ", "td>  "}
parser = ReportParser()
with System.IO.File.OpenText(report1) as f:
	while not f.EndOfStream:
		parser.feed(f.ReadLine().replace("&", ""))
parser.data1.append(parser.temp_data)
report_data = parser.data1[2:]
parser.close()
parser = None
cases, elements, = [], []
for d in report_data:
	left, right = map(str.strip, d[1].split(" : ")), map(str.strip, d[2].split(" : "))
	leftId, rightId = int(filter(str.isdigit, left[-1])), int(filter(str.isdigit, right[-1]))
	if fetch_elements:
		leftId, rightId = getElement(leftId), getElement(rightId)
	elements.append((leftId, rightId))
	
	leftCat, rightCat = fetchCat(left), fetchCat(right)
	case = "%s - %s" % (leftCat, rightCat) if leftCat is not None and rightCat is not None else "Unidentified"
	cases.append(case)

group_cases = Counter(cases).most_common()
unique_cases, sum_cases = zip(*group_cases)
sum_cases = list(sum_cases)
sum_cases.append("Total interferences : %s" % sum(sum_cases) )
#OUT = cases, elements, unique_cases, sum_cases
intersectingelements = UnwrapElement(elements)

##CHECK FOR JOINED ELEMENTS
listj = len(intersectingelements)
count = 0
arejoined = []
while (count < listj):
		if unjoinmode == False:
			result = JoinGeometryUtils.AreElementsJoined(doc, intersectingelements[count][0], intersectingelements[count][1])
		else:
			result = False
		count = count + 1
		arejoined.append(result)

joined = list(compress(intersectingelements, arejoined))
notjoined =  list(compress(intersectingelements, [not i for i in arejoined]))

##GET EXISTED WARNINGS
if CleanUpAllWarn == False and cutelems == False:
	wlist = doc.GetWarnings()
	wtext, welt, wsev = [], [], []
	for i in wlist:
		wtext.append(i.GetDescriptionText())
		welt.append(i.GetFailingElements())
		wsev.append(i.GetSeverity())

	existedwarn = []
	count = 0
	for each in wtext:
		if each == "Highlighted elements are joined but do not intersect.":
			existedwarn.append(welt[count])
		count = count + 1

TransactionManager.Instance.ForceCloseTransaction()
tGroup = TransactionGroup(doc, 'K-Join')
tGroup.Start()

trans1 = Transaction(doc, 'Switch Already Joined Elements')
if SwitchAlreadyJoined == True and cutelems == False:
	trans1.Start()
	count = 0
	while (count < len(joined)):
		try:
			JoinGeometryUtils.SwitchJoinOrder(doc, joined[count][0], joined[count][1])
			count = count + 1
		except:
			count = count +1
	trans1.Commit()

##VOLUMENTRIC SORT
if ConsiderVolume == True:
	volumes = []
	for item in notjoined:
		tmplist = []
		for each in item:
			anothertmp = []
			for matid in each.GetMaterialIds(False):
				anothertmp.append(each.GetMaterialVolume(matid))
			tmplist.append(sum(anothertmp))
		volumes.append(tmplist)

	sortedunjoined = []

	count = 0
	for eachtwo in volumes:
		sortedunjoined.append([x for _,x in sorted(zip(eachtwo,notjoined[count]))])
		count = count + 1
	notjoined = sortedunjoined

if SwitchNewJoined == True and cutelems == False:
	trans2 = Transaction(doc, 'K-Join And Switch New Elements')
else:
	if unjoinmode:
		trans2 = Transaction(doc, 'K-Join Unjoin Elements')
	else:
		if cutelems == False:
			trans2 = Transaction(doc, 'K-Join New Elements')
		else:
			trans2 = Transaction(doc, 'K-Cut Elements')
if JoinNew == True or cutelems == True or unjoinmode:
	masterjoinop(trans2,notjoined,unjoinmode,simple)

if cutelems == False:
	##Get New Warnings
	wlist = doc.GetWarnings()
	wtext, welt, wsev = [], [], []
	for i in wlist:
		wtext.append(i.GetDescriptionText())
		welt.append(i.GetFailingElements())
		wsev.append(i.GetSeverity())
	
	newwarn = []
	count = 0
	for each in wtext:
		if each == "Highlighted elements are joined but do not intersect.":
			newwarn.append(welt[count])
		count = count + 1
	
	if CleanUpAllWarn == False:
		flattenexis = []
		for eachlist in existedwarn:
			flattenexis.append(str(eachlist[0]) + str(eachlist[1]))
	
		flattennew = []
		for eachlist in newwarn:
			flattennew.append(str(eachlist[0]) + str(eachlist[1]))
		
		onlynewwarns = set(flattennew) - set(flattenexis)
	
		ind = []
		for each in onlynewwarns:
			ind.append(flattennew.index(each))
	
		resultwarn = []
		for eachindex in ind:
			resultwarn.append(newwarn[eachindex])
	else:
		resultwarn = newwarn
	
	warntounjoin = []
	for eachlist in resultwarn:
		tmplist = []
		for each in eachlist:
			tmplist.append(doc.GetElement(each))
		warntounjoin.append(tmplist)
	
	trans3 = Transaction(doc, 'Clean Up Non-Intersected Elements')
	trans3.Start()
	count = 0
	while (count < len(warntounjoin)):
		try:
			JoinGeometryUtils.UnjoinGeometry(doc, warntounjoin[count][0], warntounjoin[count][1])
			count = count + 1
		except:
			count = count +1
	trans3.Commit()
tGroup.Assimilate()

OUT = "DONE"
# ----------------------------------------
VAROUT = Output(python_script)
