# Dynamo custom node K-Laser Engine.dyf (Dynamo 2.1.0.7500)
# category: Synthesize.Automate.Lines
# K-Laser Engine

VARModelTextFamilyType = Input(VARModelTextFamilyType: var[]..[])
VARUnfoldedSurfaces = Input(VARUnfoldedSurfaces: var[]..[])
code_block = CodeBlock { true; }
dynamo_geometry_to_revit = Custom[Dynamo Geometry To Revit Compatibility](VARGeometryOrSat=VARUnfoldedSurfaces@L2, VARPreferImportInstance=code_block, VARPreferOneElement=code_block)  # Dynamo Geometry To Revit Compatibility
flatten = List.Flatten(list=dynamo_geometry_to_revit)
faces = Element.Faces(element=flatten)
firstItem = List.FirstItem(list=faces@L2)
byJoinedSurfaces = PolySurface.ByJoinedSurfaces(surfaces=VARUnfoldedSurfaces)
flatten_2 = List.Flatten(list=byJoinedSurfaces)
code_block_2 = CodeBlock { 0.5; }
pointAtParameter = Surface.PointAtParameter(surface=flatten_2, u=code_block_2, v=code_block_2)
normalAtParameter = Surface.NormalAtParameter(surface=flatten_2, u=code_block_2, v=code_block_2)
byOriginNormal = Plane.ByOriginNormal(origin=pointAtParameter, normal=normalAtParameter)
XAxis = Plane.XAxis(plane=byOriginNormal)
byFace = FamilyInstance.ByFace(familyType=VARModelTextFamilyType, face=firstItem, location=pointAtParameter, referenceDirection=XAxis)
code_block_3 = CodeBlock { "Text"; "Comments"; "K-Laser"; }
VARElementsModelText = Input(VARElementsModelText: var[]..[])
getParameterValueByName = Element.GetParameterValueByName(element=VARElementsModelText, parameterName=code_block_3.out1)
code_block_4 = CodeBlock { "K-Laser"; }
eq = getParameterValueByName == code_block_4
filterByBoolMask = List.FilterByBoolMask(list=VARElementsModelText, mask=eq)
getParameterValueByName_2 = Element.GetParameterValueByName(element=filterByBoolMask.in, parameterName=code_block_3.out0)
bk_natural_sort_list_of_strings = Custom[BK.Natural Sort List of Strings](VARlistOfStrings=getParameterValueByName_2)
lastItem = List.LastItem(list=bk_natural_sort_list_of_strings)
code_block_5 = CodeBlock { "."; }
split = String.Split(str=lastItem, separator0=code_block_5)
firstItem_2 = List.FirstItem(list=split)
python_script = Python(IN[0]=firstItem_2)
# ---------- python_script.python (15 lines) ----------
import clr
clr.AddReference('ProtoGeometry')
from Autodesk.DesignScript.Geometry import *
#The inputs to this node will be stored as a list in the IN variables.
dataEnteringNode = IN

inside = IN[0]

if inside == None:
	result = 1
else:
	result = float(inside)+1

#Assign your output to the OUT variable.
OUT = result
# ----------------------------------------
count = List.Count(list=byFace)
sequence = Sequence(start=python_script, amount=count, lacing=Longest)
flatten_3 = List.Flatten(list=sequence)
string_from_object = FromObject(obj=flatten_3)
split_2 = String.Split(str=string_from_object, separator0=code_block_5)
firstItem_3 = List.FirstItem(list=split_2@L2)
setParameterByName = Element.SetParameterByName(element=byFace, parameterName=code_block_3.out0, value=firstItem_3)
setParameterByName_2 = Element.SetParameterByName(element=byFace, parameterName=code_block_3.out1, value=code_block_3.out2)
views = Custom[CW.Document.Views]()  # Gets all views in the document - except for 3D view templates (as long as this bug is not fixed: https://github.com/DynamoDS/Dynamo/issues/2970)
name = Element.Name(element=views)
VARDraftingViewName = Input(VARDraftingViewName: var[]..[])
eq_2 = name == VARDraftingViewName
anyTrue = Custom[CW.List.AnyTrue](VARseq=eq_2)  # Returns true if any item in a list of booleans is true.
filterByBoolMask_2 = List.FilterByBoolMask(list=views, mask=eq_2)
code_block_6 = CodeBlock { null; }
scopeIf = Custom[CW.ScopeIf+](VARtest=anyTrue, VARtrue=code_block_6, VARfalse=VARDraftingViewName)  # A (hopefully) more robust implementation of ScopeIf. Tests a single boolean and returns a value accordingly.
byName = DraftingView.ByName(name=scopeIf)
scopeIf_2 = Custom[CW.ScopeIf+](VARtest=anyTrue, VARtrue=filterByBoolMask_2.in, VARfalse=byName)
firstItem_4 = List.FirstItem(list=scopeIf_2)
join = List.Join()  # unwired: list0, list1
python_script_2 = Python(IN[0]=flatten_2)
# ---------- python_script_2.python (49 lines) ----------
# Enable Python support and load DesignScript library
# IMPORTANT : ALL DYNAMO DESIGN SCRIPT NODES ARE AS (dg)
import clr
clr.AddReference('ProtoGeometry')
from Autodesk.DesignScript import Geometry as dg

# EXTENSION Enable ToDSType
clr.AddReference('RevitNodes')
import Revit
clr.ImportExtensions(Revit.Elements)

# Enable Revit Elements
from Revit.Elements import *

# EXTENSION Enable Geometry Conversion Methods
clr.ImportExtensions(Revit.GeometryConversion)

# Enable Revit API
clr.AddReference('RevitAPI')
from Autodesk.Revit.DB import *

# Enable DocumentManager and TransactionManager
clr.AddReference('RevitServices')
from RevitServices.Persistence import DocumentManager
from RevitServices.Transactions import TransactionManager

# Enable ICollection List Translate
clr.AddReference("System")
import System.Collections.Generic
from System.Collections.Generic import List

dataEnteringNode = IN
# Use UnwrapElement(IN[0]) When Translating From Dynamo to Revit
inside=UnwrapElement(IN[0])

# Choose The Current Document
doc = DocumentManager.Instance.CurrentDBDocument
uidoc = DocumentManager.Instance.CurrentUIApplication.ActiveUIDocument
uiapp = DocumentManager.Instance.CurrentUIApplication
app = uiapp.Application

# Create Empty List
result = []

for each in inside:
	result.append(each.Edges)

# Assign your output to the OUT variable.
OUT = result
# ----------------------------------------
curveGeometry = Edge.CurveGeometry(edge=python_script_2)
perimeterCurves = Surface.PerimeterCurves(surface=flatten_2)
python_script_3 = Python(IN[0]=perimeterCurves, IN[1]=curveGeometry)
# ---------- python_script_3.python (67 lines) ----------
# Enable Python support and load DesignScript library
# IMPORTANT : ALL DYNAMO DESIGN SCRIPT NODES ARE AS (dg)
import clr
clr.AddReference('ProtoGeometry')
from Autodesk.DesignScript import Geometry as dg

# EXTENSION Enable ToDSType
clr.AddReference('RevitNodes')
import Revit
clr.ImportExtensions(Revit.Elements)

# Enable Revit Elements
from Revit.Elements import *

# EXTENSION Enable Geometry Conversion Methods
clr.ImportExtensions(Revit.GeometryConversion)

# Enable Revit API
clr.AddReference('RevitAPI')
from Autodesk.Revit.DB import *

# Enable DocumentManager and TransactionManager
clr.AddReference('RevitServices')
from RevitServices.Persistence import DocumentManager
from RevitServices.Transactions import TransactionManager

# Enable ICollection List Translate
clr.AddReference("System")
import System.Collections.Generic
from System.Collections.Generic import List

dataEnteringNode = IN
# Use UnwrapElement(IN[0]) When Translating From Dynamo to Revit
PermLists=UnwrapElement(IN[0])
MasterList=UnwrapElement(IN[1])

# Choose The Current Document
doc = DocumentManager.Instance.CurrentDBDocument
uidoc = DocumentManager.Instance.CurrentUIApplication.ActiveUIDocument
uiapp = DocumentManager.Instance.CurrentUIApplication
app = uiapp.Application

fixedmaster = []
for each in MasterList:
	fixeach = []
	for e in each:
		fixeach.append(e)
	fixedmaster.append(fixeach)

# Create Empty List
result = []

globalcount = 0
for eachlist in fixedmaster:
	count = 0
	tmp = []
	for e in eachlist:
		for a in PermLists[globalcount]:
			p1 = dg.Curve.PointAtParameter(e,0.5)
			p2 = dg.Curve.PointAtParameter(a,0.5)
			if p1.X == p2.X and p1.Y == p2.Y and p1.Z == p2.Z:
				tmp.append(eachlist.IndexOf(e))
	globalcount = globalcount + 1
	result.append(tmp)

# Assign your output to the OUT variable.
OUT = result
# ----------------------------------------
removeItemAtIndex = List.RemoveItemAtIndex(list=curveGeometry@L2, indices=python_script_3@L2)
code_block_7 = CodeBlock { 0.5; }
pointAtParameter_2 = Surface.PointAtParameter(surface=flatten_2, u=code_block_7, v=code_block_7)
normalAtParameter_2 = Surface.NormalAtParameter(surface=flatten_2, u=code_block_7, v=code_block_7)
byOriginNormal_2 = Plane.ByOriginNormal(origin=pointAtParameter_2, normal=normalAtParameter_2)
byPlane = CoordinateSystem.ByPlane(plane=byOriginNormal_2)
byOrigin = CoordinateSystem.ByOrigin()
python_script_4 = Python(IN[0]=removeItemAtIndex, IN[1]=byPlane, IN[2]=byOrigin)
# ---------- python_script_4.python (58 lines) ----------
# Enable Python support and load DesignScript library
# IMPORTANT : ALL DYNAMO DESIGN SCRIPT NODES ARE AS (dg)
import clr
clr.AddReference('ProtoGeometry')
from Autodesk.DesignScript import Geometry as dg

# EXTENSION Enable ToDSType
clr.AddReference('RevitNodes')
import Revit
clr.ImportExtensions(Revit.Elements)

# Enable Revit Elements
from Revit.Elements import *

# EXTENSION Enable Geometry Conversion Methods
clr.ImportExtensions(Revit.GeometryConversion)

# Enable Revit API
clr.AddReference('RevitAPI')
from Autodesk.Revit.DB import *

# Enable DocumentManager and TransactionManager
clr.AddReference('RevitServices')
from RevitServices.Persistence import DocumentManager
from RevitServices.Transactions import TransactionManager

# Enable ICollection List Translate
clr.AddReference("System")
import System.Collections.Generic
from System.Collections.Generic import List

dataEnteringNode = IN
# Use UnwrapElement(IN[0]) When Translating From Dynamo to Revit
geom=UnwrapElement(IN[0])
fromco=UnwrapElement(IN[1])
toco=UnwrapElement(IN[2])

# Choose The Current Document
doc = DocumentManager.Instance.CurrentDBDocument
uidoc = DocumentManager.Instance.CurrentUIApplication.ActiveUIDocument
uiapp = DocumentManager.Instance.CurrentUIApplication
app = uiapp.Application

# Create Empty List
result = []

count = 0
for each in geom:
	tmp = []
	for e in each:
		try:
			tmp.append(dg.Geometry.Transform(e,fromco[count],toco))
		except:
			tmp.append(None)
	count = count + 1
	result.append(tmp)
		
OUT = result
# ----------------------------------------
VARSegmentationDistance = Input(VARSegmentationDistance: var[]..[])
lines_segmentation_by_distance = Custom[Lines Segmentation By Distance](VARCurves=python_script_4@L2, VARSegmentationDistance=VARSegmentationDistance)  # Lines Segmentation By Distance
python_script_5 = Python(IN[0]=lines_segmentation_by_distance, IN[1]=python_script_4)
# ---------- python_script_5.python (56 lines) ----------
# Enable Python support and load DesignScript library
# IMPORTANT : ALL DYNAMO DESIGN SCRIPT NODES ARE AS (dg)
import clr
clr.AddReference('ProtoGeometry')
from Autodesk.DesignScript import Geometry as dg

# EXTENSION Enable ToDSType
clr.AddReference('RevitNodes')
import Revit
clr.ImportExtensions(Revit.Elements)

# Enable Revit Elements
from Revit.Elements import *

# EXTENSION Enable Geometry Conversion Methods
clr.ImportExtensions(Revit.GeometryConversion)

# Enable Revit API
clr.AddReference('RevitAPI')
from Autodesk.Revit.DB import *

# Enable DocumentManager and TransactionManager
clr.AddReference('RevitServices')
from RevitServices.Persistence import DocumentManager
from RevitServices.Transactions import TransactionManager

# Enable ICollection List Translate
clr.AddReference("System")
import System.Collections.Generic
from System.Collections.Generic import List

dataEnteringNode = IN
# Use UnwrapElement(IN[0]) When Translating From Dynamo to Revit
geom=UnwrapElement(IN[0])
fixer = UnwrapElement(IN[1])

# Choose The Current Document
doc = DocumentManager.Instance.CurrentDBDocument
uidoc = DocumentManager.Instance.CurrentUIApplication.ActiveUIDocument
uiapp = DocumentManager.Instance.CurrentUIApplication
app = uiapp.Application

# Create Empty List
result = []
if geom != None:
	for each in geom:
		tmp = []
		for e in each:
			try:
				tmp.append(dg.PolyCurve.Curves(e))
			except:
				tmp.append(None)
		result.append(tmp)
else:
	result = fixer
OUT = result
# ----------------------------------------
isEmpty = List.IsEmpty(list=python_script_5, lacing=Longest)
filterByBoolMask_3 = List.FilterByBoolMask(list=python_script_5, mask=isEmpty)
code_block_8 = CodeBlock { 2; }
dropEveryNthItem = List.DropEveryNthItem(list=filterByBoolMask_3.out@@L2, n=code_block_8)
mergeByBoolMask = Custom[SP.List.MergeByBoolMask](VARIn=filterByBoolMask_3.in, VAROut=dropEveryNthItem, VARmask=isEmpty)  # Merge two lists by a boolean mask list. The true count in the mask should be the same as the length of the true list and vice versa for the false list.
flatten_4 = List.Flatten(list=mergeByBoolMask@L3)
code_block_9 = CodeBlock { 2; }
normalizeDepth = List.NormalizeDepth(list=flatten_4, rank=code_block_9)
filterByBoolMask_4 = List.FilterByBoolMask(list=normalizeDepth, mask=isEmpty)
code_block_10 = CodeBlock { false; }
clean = List.Clean(list=filterByBoolMask_4.out, preserveIndices=code_block_10)
perimeterCurves_2 = Surface.PerimeterCurves(surface=flatten_2)
border = Geometry.Transform(geometry=perimeterCurves_2, fromCoordinateSystem=byPlane, contextCoordinateSystem=byOrigin)
filterByBoolMask_5 = List.FilterByBoolMask(list=border, mask=isEmpty)
clean_2 = List.Clean(list=filterByBoolMask_5.out, preserveIndices=code_block_10)
combine = List.Combine(comb=join, list1=clean, list2=clean_2)
filterByBoolMask_6 = List.FilterByBoolMask(list=border, mask=isEmpty)
python_script_6 = Python(IN[0]=combine, IN[1]=filterByBoolMask_6.in)
# ---------- python_script_6.python (16 lines) ----------
import clr
clr.AddReference('ProtoGeometry')
from Autodesk.DesignScript.Geometry import *
#The inputs to this node will be stored as a list in the IN variables.
dataEnteringNode = IN

one = IN[0]
two = IN[1]

try:
	result = one + two
except:
	result = two

#Assign your output to the OUT variable.
OUT = result
# ----------------------------------------
byGeometry = BoundingBox.ByGeometry(geom=python_script_6, lacing=Longest)
minPoint = BoundingBox.MinPoint(boundingBox=byGeometry)
byOrigin_2 = CoordinateSystem.ByOrigin(origin=minPoint)
code_block_11 = CodeBlock { 0; }
dimensions = Custom[ZK.BoundingBox.Dimensions](VARBoundingBox=byGeometry)  # Input Bounding Box element to get its dimensions (Width, Length, Height). Setting Boolean switch to True rounds output values.
VARDistanceBetweenLaserPiecesInDraftingV = Input(VARDistanceBetweenLaserPiecesInDraftingView: var[]..[])
add = dimensions.VARWidth + VARDistanceBetweenLaserPiecesInDraftingV
lb_lunchbox_mass_addition = Custom[LB.LunchBox Mass Addition](VARNumbers=add)  # Returns the total value of a list of numbers.
addItemToFront = List.AddItemToFront(item=code_block_11, list=lb_lunchbox_mass_addition.VARPartials)
code_block_12 = CodeBlock { null; }
scopeIf_3 = Custom[CW.ScopeIf+](VARtest=anyTrue, VARtrue=scopeIf_2, VARfalse=code_block_12)
ds_all_elements_in_view_s = Custom[DS.All Elements In View(s)](VARViews=scopeIf_3)  # Retrieves all visible element in a view or a set of views
code_block_13 = CodeBlock { "DetailCurve"; }
byClassName = Custom[SP.Filter.ByClassName](VARobject=ds_all_elements_in_view_s, VARclassName=code_block_13)  # Filters a list of objects by the object's class name. Note that Dynamo elements belong to different classes than their Revit counterparts. Use the Object.Class node to check an object's class.
python_null_2_empty = Custom[Python Null 2 Empty](VARIN=byClassName.VARin)  # Python Null 2 Empty
code_block_14 = CodeBlock { false; }
clean_3 = List.Clean(list=python_null_2_empty, preserveIndices=code_block_14)
curves = Element.Curves(element=clean_3)
flatten_5 = List.Flatten(list=curves)
byGeometry_2 = BoundingBox.ByGeometry(geom=flatten_5)
dimensions_2 = Custom[ZK.BoundingBox.Dimensions](VARBoundingBox=byGeometry_2)
add_2 = addItemToFront + dimensions_2.VARWidth  # lacing=Longest
add_3 = add_2 + VARDistanceBetweenLaserPiecesInDraftingV  # lacing=Longest
minPoint_2 = BoundingBox.MinPoint(boundingBox=byGeometry_2)
X = Point.X(point=minPoint_2)
add_4 = add_3 + X  # lacing=Longest
scopeIf_4 = Custom[CW.ScopeIf+](VARtest=anyTrue, VARtrue=add_4, VARfalse=addItemToFront)
code_block_15 = CodeBlock { -1; }
dropItems = List.DropItems(list=scopeIf_4, amount=code_block_15)
byOrigin_3 = CoordinateSystem.ByOrigin(x=dropItems)
transform = Geometry.Transform(geometry=python_script_6, fromCoordinateSystem=byOrigin_2, contextCoordinateSystem=byOrigin_3)
code_block_16 = CodeBlock { false; }
clean_4 = List.Clean(list=transform, preserveIndices=code_block_16)
flatten_6 = List.Flatten(list=clean_4)
byCurve = DetailCurve.ByCurve(view=firstItem_4, curve=flatten_6)
join_2 = List.Join()  # unwired: list0, list1, list2
code_block_17 = CodeBlock { 0.25; 0.5; 0.75; }
pointAtParameter_3 = Curve.PointAtParameter(curve=clean_4, param=code_block_17.out0)
pointAtParameter_4 = Curve.PointAtParameter(curve=clean_4, param=code_block_17.out1)
pointAtParameter_5 = Curve.PointAtParameter(curve=clean_4, param=code_block_17.out2)
combine_2 = List.Combine(comb=join_2, list1=pointAtParameter_3, list2=pointAtParameter_4, list3=pointAtParameter_5)
byBestFitThroughPoints = Plane.ByBestFitThroughPoints(points=combine_2)
origin = Plane.Origin(plane=byBestFitThroughPoints)
code_block_18 = CodeBlock { "Align Center"; }
VARTextTypeInDraftingView = Input(VARTextTypeInDraftingView: var[]..[])
byName_2 = TextNoteType.ByName(name=VARTextTypeInDraftingView)
isNull = Object.IsNull(obj=byName_2)
default = TextNoteType.Default()
scopeIf_5 = Custom[CW.ScopeIf+](VARtest=isNull, VARtrue=default, VARfalse=byName_2)
byLocation = TextNote.ByLocation(view=firstItem_4, location=origin, text=firstItem_3, alignment=code_block_18, type=scopeIf_5)
create = List.Create(item0=byCurve, item1=byLocation, item2=firstItem_4, item3=scopeIf_5, item4=ds_all_elements_in_view_s, item5=views)
code_block_19 = CodeBlock { false; }
clean_5 = List.Clean(list=create, preserveIndices=code_block_19)
flatten_7 = List.Flatten(list=clean_5)
VAROutput = Output(flatten_7)
create_2 = List.Create(item0=byFace, item1=flatten)
code_block_20 = CodeBlock { false; }
clean_6 = List.Clean(list=create_2, preserveIndices=code_block_20)
flatten_8 = List.Flatten(list=clean_6)
VAROutputFilter = Output(flatten_8)
