# Dynamo custom node K-Paneling Data Import.dyf (Dynamo 2.1.0.7500)
# category: Synthesize.Automate.Family
# K-Paneling Data Import

VARDirectoryPath = Input(VARDirectoryPath: var[]..[])
python_script = Python(IN[0]=VARDirectoryPath)
# ---------- python_script.python (59 lines) ----------
# Load theer DesignScript Libraries
import sys
import clr
clr.AddReference('ProtoGeometry')
from Autodesk.DesignScript.Geometry import *
import pickle
import os
from System import Array, Byte
directorypath = IN[0]

def convert(list,single):
	if single:
		try:
			bytes = Array[Byte](list)
			converted = Geometry.DeserializeFromSAB(bytes)
		except:
			converted = list
	else:
		converted = []
		try:
			for l in list:
				try:
					bytes = Array[Byte](l)
					converted.append(Geometry.DeserializeFromSAB(bytes))
				except:
					converted.append(l)
		except:
			converted = list
	return converted
	
f = []
for (dirpath, dirnames, filenames) in os.walk(directorypath):
	f.extend(filenames)
	break
	
fullfiles = []
for file in f:
	if "K-Paneling" in file and ".data" in file:
		fullfiles.append(directorypath + "\\" + file)

gooddata = []
goodfiles = []
if len(fullfiles) != 0:
	for file in fullfiles:		
		fd = open(file, 'rb')
		try:
			dataset = list(pickle.load(fd))
			dataset[0] = convert(dataset[0],True)
			dataset[16] = convert(dataset[16],False)
			dataset[17] = convert(dataset[17],False)
			dataset[18] = convert(dataset[18],False)
			gooddata.append(dataset)
			goodfiles.append(file)
		except:
			pass
		fd.close()

# Assign your output to the OUT variable.
OUT = gooddata,goodfiles
# ----------------------------------------
code_block = CodeBlock(a=python_script) { a[0]; a[1]; }
transpose = List.Transpose(lists=code_block.out0)
code_block_2 = CodeBlock(a=transpose)
# ---------- code_block_2.designscript (31 lines) ----------
a[0];
a[1];
a[2];
a[3];
a[4];
a[5];
a[6];
a[7];
a[8];
a[9];
a[10];
a[11];
a[12];
a[13];
a[14];
a[15];
a[16];
a[17];
a[18];
a[19];
a[20];
a[21];
a[22];
a[23];
a[24];
a[25];
a[26];
a[27];
a[28];
a[29];
a[30];
# ----------------------------------------
VARSurfaces = Output(code_block_2.out0)
VARBorderDepth = Output(code_block_2.out1)
VARBorderWidth = Output(code_block_2.out2)
VARDistanceU = Output(code_block_2.out3)
VARDistanaceV = Output(code_block_2.out4)
VARMethodU = Output(code_block_2.out5)
VARMethodV = Output(code_block_2.out6)
VARUWidth = Output(code_block_2.out7)
VARUDepth = Output(code_block_2.out8)
VARVWidth = Output(code_block_2.out9)
VARVDepth = Output(code_block_2.out10)
VARExtendFix = Output(code_block_2.out11)
VARPrecision = Output(code_block_2.out12)
VARPanelThickness = Output(code_block_2.out13)
VARCreatePanels = Output(code_block_2.out14)
VARSafeThickenFactor = Output(code_block_2.out15)
python_script_2 = Python(IN[0]=code_block_2.out16, IN[1]=code_block_2.out28)
# ---------- python_script_2.python (24 lines) ----------
# Load the Python Standard and DesignScript Libraries
import sys
import clr
clr.AddReference('ProtoGeometry')
from Autodesk.DesignScript.Geometry import *

lists = IN[0]
listscount = IN[1]

newlistscount = []
count = 0
for list in lists:
	listcount = listscount[count]
	count += 1
	tmp = []
	if listcount == None:
		for l in list:
			tmp.append([0])
	else:
		for l in listcount:
			tmp.append(l)
	newlistscount.append(tmp)

OUT = newlistscount
# ----------------------------------------
chop = List.Chop(list=code_block_2.out16@L2, lengths=python_script_2@@L2)
as_polycurve_bycurves_with = Custom[AS.[&] PolyCurve.ByCurves With Failures Sandbox](VARcurves=chop@@L2)  # Create polycurves from an unordered list of curves.
python_script_3 = Python(IN[0]=as_polycurve_bycurves_with.VARpolyCurve)
# ---------- python_script_3.python (35 lines) ----------
# Load the Python Standard and DesignScript Libraries
import sys
import clr
clr.AddReference('ProtoGeometry')
from Autodesk.DesignScript.Geometry import *

# The inputs to this node will be stored as a list in the IN variables.
dataEnteringNode = IN

def flatten(x):
    result = []
    for el in x:
        if hasattr(el, "__iter__") and not isinstance(el, basestring):
            result.extend(flatten(el))
        else:
            result.append(el)
    return result

lists = IN[0]

count = 0
newlists = []
for list in lists:
	tmp = []
	for l in list:
		try:
			l = flatten(l)
		except:
			l = l
		tmp.append(l)
	newlists.append(tmp)
	count += 1

# Assign your output to the OUT variable.
OUT = newlists
# ----------------------------------------
as_overkill_bycurves = Custom[AS.[&] Overkill ByCurves](VARcurves=python_script_3)  # Create polycurves from an unordered list of curves.
VARCustomGridU = Output(as_overkill_bycurves)
python_script_4 = Python(IN[0]=code_block_2.out17, IN[1]=code_block_2.out29)  # same code as python_script_2
chop_2 = List.Chop(list=code_block_2.out17@L2, lengths=python_script_4@@L2)
as_polycurve_bycurves_with_2 = Custom[AS.[&] PolyCurve.ByCurves With Failures Sandbox](VARcurves=chop_2@@L2)
python_script_5 = Python(IN[0]=as_polycurve_bycurves_with_2.VARpolyCurve)  # same code as python_script_3
as_overkill_bycurves_2 = Custom[AS.[&] Overkill ByCurves](VARcurves=python_script_5)
VARCustomGridV = Output(as_overkill_bycurves_2)
python_script_6 = Python(IN[0]=code_block_2.out18, IN[1]=code_block_2.out30)  # same code as python_script_2
chop_3 = List.Chop(list=code_block_2.out18@L2, lengths=python_script_6@@L2)
as_polycurve_bycurves_with_3 = Custom[AS.[&] PolyCurve.ByCurves With Failures Sandbox](VARcurves=chop_3@@L2)
python_script_7 = Python(IN[0]=as_polycurve_bycurves_with_3.VARpolyCurve)  # same code as python_script_3
as_overkill_bycurves_3 = Custom[AS.[&] Overkill ByCurves](VARcurves=python_script_7)
VARCustomGridW = Output(as_overkill_bycurves_3)
VARWWidth = Output(code_block_2.out19)
VARWDepth = Output(code_block_2.out20)
VARRemoveSameGridConflict = Output(code_block_2.out21)
VARUOffset = Output(code_block_2.out22)
VARVOffset = Output(code_block_2.out23)
VARWOffset = Output(code_block_2.out24)
VARPanelOffset = Output(code_block_2.out25)
VARBorderOffset = Output(code_block_2.out26)
VARFiles = Output(code_block.out1)
VARIsSolid = Output(code_block_2.out27)
