# Dynamo custom node K-Paneling Framing Only.dyf (Dynamo 2.1.0.7500)
# category: Synthesize.Automate.Surface
# Create Frames By Surfaces

VARSuraces = Input(VARSuraces: var[]..[])
VARFrameDepth = Input(VARFrameDepth: double = 0.2)
VARFrameWidth = Input(VARFrameWidth: double = 0.1)
VARSafeThickenFactor = Input(VARSafeThickenFactor: double = 1.65)
VAROnlySubtractedSurfaces = Input(VAROnlySubtractedSurfaces: bool = false)
python_script = Python(IN[0]=VARSuraces, IN[1]=VARFrameDepth, IN[2]=VARFrameWidth, IN[3]=VARSafeThickenFactor, IN[4]=VAROnlySubtractedSurfaces)
# ---------- python_script.python (895 lines) ----------
# Proudly Created By Karam Baki : karam@aecedx.com
# Enable Python support and load DesignScript library
# IMPORTANT : ALL DYNAMO DESIGN SCRIPT NODES ARE AS (dg)
import clr
clr.AddReference('ProtoGeometry')
from Autodesk.DesignScript import Geometry as dg

# EXTENSION Enable ToDSType
clr.AddReference('RevitNodes')
import Revit
clr.ImportExtensions(Revit.Elements)

# Enable Revit Elements
from Revit.Elements import *

# EXTENSION Enable Geometry Conversion Methods
clr.ImportExtensions(Revit.GeometryConversion)

# Enable Revit API
clr.AddReference('RevitAPI')
from Autodesk.Revit.DB import *

# Enable DocumentManager and TransactionManager
clr.AddReference('RevitServices')
from RevitServices.Persistence import DocumentManager
from RevitServices.Transactions import TransactionManager

# Enable ICollection List Translate
clr.AddReference("System")
import System.Collections.Generic
from System.Collections.Generic import List

clr.AddReference('DynamoRevitDS')
import Dynamo
clr.AddReference("RevitAPIUI")
from Autodesk.Revit.UI import TaskDialog
import math

import System
pf_path = System.Environment.GetFolderPath(System.Environment.SpecialFolder.ProgramFilesX86)
import sys
sys.path.append('%s\IronPython 2.7\Lib' %pf_path)
from distutils.version import LooseVersion
import random
import string

def flatten(x):
    result = []
    for el in x:
        if hasattr(el, "__iter__") and not isinstance(el, basestring):
            result.extend(flatten(el))
        else:
            result.append(el)
    return result

def tolist(obj1):
	if hasattr(obj1,'__iter__'): return obj1
	else: return [obj1]

def recreatesurfaces(surfaces,RevitCheck=True,ForceRecreate=False,doc=DocumentManager.Instance.CurrentDBDocument,temp_path=System.IO.Path.GetTempPath()):
	class WarnSwallowImport(IFailuresPreprocessor):
		def PreprocessFailures(self, failuresAccessor):
			failuresAccessor.DeleteAllWarnings()
			return FailureProcessingResult.Continue
	def flatten(x):
	    result = []
	    for el in x:
	        if hasattr(el, "__iter__") and not isinstance(el, basestring):
	            result.extend(flatten(el))
	        else:
	            result.append(el)
	    return result
	
	def tolist(obj1):
		if hasattr(obj1,'__iter__'): return obj1
		else: return [obj1]
	def cleanupSurface(surface):
		def isActuallygood(geomorsat,converted):
			geometrymode = True
			originalfaces = []
			if isinstance(geomorsat,dg.Solid) or isinstance(geomorsat,dg.PolySurface):
				exploded = dg.Geometry.Explode(geomorsat)
				for exp in exploded:
					originalfaces.append(exp)
					if exp.Closed:
						originalfaces.append(exp)
			elif isinstance(geomorsat,dg.Surface):
				if geometrymode == False:
					originalfaces.append(geomorsat)
					if geomorsat.Closed:
						originalfaces.append(geomorsat)
				else:
					exploded = dg.Geometry.Explode(geomorsat)
					for exp in exploded:
						originalfaces.append(exp)
						if exp.Closed:
							originalfaces.append(exp)
			elif isinstance(geomorsat,str):
				geomsorsat = dg.Geometry.ImportFromSAT(geomorsat)
				for geomorsat in geomsorsat:
					if isinstance(geomorsat,dg.Solid) or isinstance(geomorsat,dg.PolySurface):
						exploded = dg.Geometry.Explode(geomorsat)
						for exp in exploded:
							originalfaces.append(exp)
							if exp.Closed:
								originalfaces.append(exp)
						if geometrymode == False and doc.IsFamilyDocument:
							geomorsat.Dispose()
					elif isinstance(geomorsat,dg.Surface):
						if geometrymode == False:
							originalfaces.append(geomorsat)
							if geomorsat.Closed:
								originalfaces.append(geomorsat)
						else:
							exploded = dg.Geometry.Explode(geomorsat)
							for exp in exploded:
								originalfaces.append(exp)
								if exp.Closed:
									originalfaces.append(exp)
				if geometrymode:
					geomorsat = list(geomsorsat)
			originalnum = len(originalfaces)
			for org in originalfaces:
				org.Dispose()
			FFfaces = []
			for e in converted:
				getfaces = e.Faces
				for gotten in getfaces:
					FFfaces.append(gotten)
			FFfacesnum = len(FFfaces)
			if FFfacesnum >= originalnum:
				samefaces = True
			else:
				samefaces = False
			return samefaces
		def checkcompatible(geoms,RevitCheck):
			if RevitCheck == False:
				return True
			randomname = ''.join([random.choice(string.ascii_letters + string.digits) for n in xrange(5)])
			sat_path = '%s%s.sat' % (temp_path, randomname)
			dg.Geometry.ExportToSAT(geoms,sat_path)
			converted = []
			shapeImporter = ShapeImporter()
			converted = list(shapeImporter.Convert(doc, sat_path))
			shapeImporter.Dispose()
			System.IO.File.Delete(sat_path)
			for e in converted:
				if e.ToString() == "Autodesk.Revit.DB.Mesh":
					return False
			if len(converted) != 0:
				converted = isActuallygood(geoms,converted)
			return converted
		def meternumber(value):
			value = value
			return value
		def metersurfarea(surface):
			area = meternumber(surface.Area)
			return area
		def almostsame(surf1,surf2,tollerance = 3):
			if round(metersurfarea(surf1),tollerance) == round(metersurfarea(surf2),tollerance):
				return True
			else:
				return False
		def subtractfunction(nurbs,cleanexplodes):
			def loopclean(nurbs,thick,counter):
				result = dg.Surface.SubtractFrom(nurbs,thick)[0]
				if counter != 0:
					nurbs.Dispose()
				thick.Dispose()
				return result
			thickforms = []
			for cleanex in cleanexplodes:
				safearea = metersurfarea(cleanex)/10
				if safearea > meternumber(0.1):
					maxthicken = meternumber(0.1)
				else:
					maxthicken = safearea
				thickforms.append(dg.Surface.Thicken(cleanex,maxthicken,True))
			counter = 0
			for thick in thickforms:
				nurbs = loopclean(nurbs,thick,counter)
				counter += 1
			return nurbs
		def tryingforall(surface,nurbs,cleanexplodes,geometrymode):
			try:
				finalsub = subtractfunction(nurbs,cleanexplodes)
				return [finalsub]
			except:
				try:
					finalsub = dg.Surface.Difference(nurbs,cleanexplodes)
					return [finalsub]
				except Exception as e:
					if str(e) == "Cannot difference an empty list" and almostsame(nurbs,surface):
						finalsub = nurbs
						try:
							return [finalsub]
						except:
							return None
		def gencleanexplodes(subtractnurbs):
			if isinstance(subtractnurbs, list):
				if len(subtractnurbs) == 0:
					return []
			else:
				explodednurbs = dg.Geometry.Explode(subtractnurbs)
				cleanexplodes = []
				if safemode:
					for ex in explodednurbs:
						if ex.Area < meternumber(0.002):
							ex.Dispose()
						else:
							cleanexplodes.append(ex)
				else:
					cleanexplodes = list(explodednurbs)
				subtractnurbs.Dispose()
				return cleanexplodes
		def easymethod(surface,geometrymode):
			try:
				nurbs = dg.Surface.ToNurbsSurface(surface)
				if almostsame(nurbs,surface):
					try:
						return True,[nurbs]
					except:
						return None,nurbs
				else:
					return None,nurbs
			except:
				return None,None
		def isplanarsurf(s):
			norms = [0,0.333,0.666,1]
			pts = []
			for n in norms:
				for n2 in norms:
					pts.append(dg.Surface.PointAtParameter(s,n,n2))
			plane = dg.Plane.ByBestFitThroughPoints(pts)
			status = True
			for p in pts:
				try:
					inter = dg.Geometry.DoesIntersect(p,plane)
					if inter == False:
						status = False
						break
				except:
					pass
			return status
		def joincurves(crvs):
			def PointsEqual(pt1, pt2):
				tolerance = 0.00001
				if (math.fabs(pt1.X - pt2.X) < tolerance and
					math.fabs(pt1.Y - pt2.Y) < tolerance and
					math.fabs(pt1.Z - pt2.Z) < tolerance):
					return True
				else:
					return False
			crvs = flatten(tolist(crvs))
			crvGroup = [-1 for x in range(len(crvs))]
			crvGroup[0] = 0
			maxGroupNum = 1
			starts = []
			ends = []
			for crv in crvs:
				starts.append(crv.PointAtParameter(0))
				ends.append(crv.PointAtParameter(1))
			for i in range(len(crvs)):
				if (crvGroup[i] == -1):
					crvGroup[i] = i
				for j in range(len(crvs)):
					if (i != j and
						(PointsEqual(starts[i], starts[j]) or
						PointsEqual(starts[i], ends[j]) or
						PointsEqual(ends[i], starts[j]) or
						PointsEqual(ends[i], ends[j]))):
						if (crvGroup[j] == -1):
							crvGroup[j] = crvGroup[i]
						elif (crvGroup[i] != crvGroup[j]):
							oldNum = crvGroup[j]
							for k in range(len(crvs)):
								if (crvGroup[k] == oldNum):
									crvGroup[k] = crvGroup[i]
			groups = []
			excluded = []
			for n in crvGroup:
				innercount = 0
				tmp = []
				for n2 in crvGroup:
					if n == n2 and n2 not in excluded:
						tmp.append(crvs[innercount])
					innercount += 1
				if len(tmp) == 0:
					continue
				try:
					tmp = dg.PolyCurve.ByJoinedCurves(tmp)
					groups.append(tmp)
				except:
					for t in tmp:
						groups.append(dg.PolyCurve.ByJoinedCurves([t]))
				excluded.append(n)
			joinedcurves = groups
			return joinedcurves
		def trimloopmethod(surface,nurbs,geometrymode):
			try:
				if surface.Closed:
					return None
				try:
					joinedperms = [dg.PolyCurve.ByJoinedCurves(surface.PerimeterCurves())]
				except:
					joinedperms = joincurves(surface.PerimeterCurves())
				finalsub = dg.Surface.TrimWithEdgeLoops(nurbs,joinedperms)
				if almostsame(finalsub,surface):
					return [finalsub]
				else:
					return None
			except:
				return None
		def thickenintersectMethod(surface,nurbs,geometrymode,pointOneMeter):
			try:
				tmp_thicken = dg.Surface.Thicken(surface,pointOneMeter,True)
				isplanar = isplanarsurf(surface)
				if isplanar:
					tmp_pt = dg.Surface.PointAtParameter(surface,0.5,0.5)
					tmp_norm = dg.Surface.NormalAtPoint(surface,tmp_pt)
					intersecter = dg.Plane.ByOriginNormal(tmp_pt,tmp_norm)
					finalsub = dg.Geometry.Intersect(intersecter,tmp_thicken)
					for f in finalsub:
						if isinstance(f,dg.Surface):
							finalsub = f
							break
					tmp_thicken.Dispose()
				else:
					finalsub = dg.Geometry.Intersect(nurbs,tmp_thicken)
					for f in finalsub:
						if isinstance(f,dg.Surface):
							finalsub = f
							break
					tmp_thicken.Dispose()
				return [finalsub]
			except:
				return None
		def inithickenMethod(surface,nurbs,geometrymode):
			try:
				safearea = metersurfarea(surface)/10
				if safearea > meternumber(0.1):
					maxthicken = meternumber(0.1)
				else:
					maxthicken = safearea
				thickeninit = dg.Surface.Thicken(surface,maxthicken,True)
				try:
					subtractnurbs = dg.Surface.SubtractFrom(nurbs,thickeninit)[0]
				except Exception as e:
					if "index out of range" in str(e) and almostsame(nurbs,surface):
						subtractnurbs = []
					elif "index out of range" in str(e):
						try:
							subtractnurbs = dg.Surface.Difference(nurbs,[surface])
						except Exception as e:
							if str(e) == "Unable to get FACE from BODY: no faces in BODY":
								subtractnurbs = []
				thickeninit.Dispose()
				cleanexplodes = gencleanexplodes(subtractnurbs)
				tryall = tryingforall(surface,nurbs,cleanexplodes,geometrymode)
				if tryall != None:
					return tryall
				else:
					return None
			except:
				return None
		def simplesubmethod(surface,nurbs,geometrymode):
			try:
				try:
					subtractnurbs = dg.Surface.Difference(nurbs,[surface])
				except Exception as e:
					if str(e) == "Unable to get FACE from BODY: no faces in BODY":
						try:
							return [nurbs]
						except:
							return None
				cleanexplodes = gencleanexplodes(subtractnurbs)
				tryall = tryingforall(surface,nurbs,cleanexplodes,geometrymode)
				if tryall != None:
					return tryall
				else:
					return None
			except:
				return None
		geometrymode = True
		safemode = False
		pointOneMeter = 0.1
		if ForceRecreate == False:
			if checkcompatible(surface,RevitCheck):
				return surface
		easy = easymethod(surface,geometrymode)
		if easy[0] != None:
			return easy[1][0]
		elif easy[0] == None and easy[1] == None:
			return surface
		else:
			nurbs = easy[1]
		trimloop = trimloopmethod(surface,nurbs,geometrymode)
		if trimloop != None:
			if checkcompatible(trimloop[0],RevitCheck):
				return trimloop[0]
		simple = simplesubmethod(surface,nurbs,geometrymode)
		if simple != None:
			if checkcompatible(simple[0],RevitCheck):
				return simple[0]
		inithick = inithickenMethod(surface,nurbs,geometrymode)
		if inithick != None:
			if checkcompatible(inithick[0],RevitCheck):
				return inithick[0]
		thickeninter = thickenintersectMethod(surface,nurbs,geometrymode,pointOneMeter)
		if thickeninter != None:
			if checkcompatible(thickeninter[0],RevitCheck):
				return thickeninter[0]
		return surface
	
	TransactionManager.Instance.ForceCloseTransaction()
	trans = Transaction(doc, 'Temporary Transaction')
	trans.Start()
	warnhandle = WarnSwallowImport()
	foptions = trans.GetFailureHandlingOptions()
	foptions.SetFailuresPreprocessor(warnhandle)
	foptions.SetClearAfterRollback(True)
	trans.SetFailureHandlingOptions(foptions)
	surfaces = flatten(tolist(surfaces))
	cleanedsurfs = []
	for s in surfaces:
		cleanedsurfs.append(cleanupSurface(s))
	surfaces = cleanedsurfs
	trans.RollBack()
	return surfaces

def isplanarsurf(s):
	norms = [0,0.333,0.666,1]
	pts = []
	for n in norms:
		for n2 in norms:
			pts.append(dg.Surface.PointAtParameter(s,n,n2))
	plane = dg.Plane.ByBestFitThroughPoints(pts)
	status = True
	for p in pts:
		try:
			inter = dg.Geometry.DoesIntersect(p,plane)
			if inter == False:
				status = False
				break
		except:
			pass
	return status

def iscurvesurf(s):
	norms = [0,0.333,0.666,1]
	try:
		for n in norms:
			curve1 = dg.Geometry.Explode(dg.Curve.ByIsoCurveOnSurface(s,0,n))[0]
			curve2 = dg.Geometry.Explode(dg.Curve.ByIsoCurveOnSurface(s,1,n))[0]
			if (isinstance(curve1, dg.Line) or isinstance(curve1, dg.Circle)) and (isinstance(curve2, dg.Line) or isinstance(curve2, dg.Circle)):
				continue
			else:
				isgood = False
				try:
					arclength1 = dg.Arc.ByThreePoints(curve1.StartPoint,dg.Curve.PointAtParameter(curve1,0.5),curve1.EndPoint).Length
					if round(arclength1,2) == round(curve1.Length):
						continue
					else:
						return False
				except:	
					isgood = True
					pass
				try:
					arclength2 = dg.Arc.ByThreePoints(curve2.StartPoint,dg.Curve.PointAtParameter(curve2,0.5),curve2.EndPoint).Length
					if round(arclength2,2) == round(curve2.Length):
						continue
					else:
						return False
				except:
					isgood = True
					pass
				if isgood:
					continue
		return True
	except:
		return False

dataEnteringNode = IN
# Use UnwrapElement(IN[0]) When Translating From Dynamo to Revit
surfs= UnwrapElement(tolist(IN[0]))
bord = IN[1]
borw = IN[2]
safethickfactor = IN[3]
onlysubs = IN[4]

cleanedsurfs = []
for s in surfs:
	if isplanarsurf(s) or iscurvesurf(s):
		cleanedsurfs.append(s)
	else:
		cleanedsurfs.append(recreatesurfaces(s,True,True)[0])
surfs = cleanedsurfs

# Choose The Current Document
doc = DocumentManager.Instance.CurrentDBDocument
uidoc = DocumentManager.Instance.CurrentUIApplication.ActiveUIDocument
uiapp = DocumentManager.Instance.CurrentUIApplication
app = uiapp.Application

if int(DocumentManager.Instance.CurrentUIApplication.Application.VersionNumber) < 2021:
	unit_type = UnitType.UT_Length
	formatoptions = doc.GetUnits().GetFormatOptions(unit_type)
	dispunits = formatoptions.DisplayUnits
	safethickfactor = UnitUtils.ConvertFromInternalUnits(safethickfactor,dispunits)
else:
	safethickfactor = UnitUtils.ConvertFromInternalUnits(safethickfactor,doc.GetUnits().GetFormatOptions(SpecTypeId.Length).GetUnitTypeId())

def getbestold(fixedexploded,bord,solid):
	tmpareas = []
	for x in fixedexploded:
		tmpareas.append(x.Area)
	status = "Again"
	while status == "Again":
		maxarea = max(tmpareas)
		innercount = 0
		for r in tmpareas:
			if maxarea == r:
				point_onsurf = dg.Surface.PointAtParameter(fixedexploded[innercount])
				vec_onsurf = dg.Surface.NormalAtParameter(fixedexploded[innercount])
				transformed = dg.Geometry.Translate(point_onsurf,vec_onsurf,bord/1.5)
				if dg.Geometry.DoesIntersect(transformed,solid):
					fixedexploded.pop(innercount)
					tmpareas.pop(innercount)
					status = "Again"
					break
				else:
					surfi = fixedexploded.pop(innercount)
					wanted1 = dg.Surface.Thicken(surfi,borw*-1,False)
					surfi.Dispose()
					tmpareas.pop(innercount)
					status = "Stop"
					break
			innercount += 1
	return wanted1,fixedexploded

def framesv2(surfs,bord,borw):
	thickned = []
	wantedwitdh = borw  * 2
	wanteddepth = wantedwitdh + bord
	thickned = dg.Surface.Thicken(surfs,wanteddepth,True)
	count = 0
	thinedshell = dg.Solid.ThinShell(thickned,borw,0)
	exploded = dg.Geometry.Explode(thinedshell)
	fixedexploded = []
	for x in exploded:
		fixedexploded.append(x)
	wanted = getbestold(fixedexploded,bord,thickned)
	wanted1 = wanted[0]
	wanted2 = getbestold(wanted[1],bord,thickned)[0]
	allwants = [wanted1,wanted2]
	finalresult = dg.Solid.DifferenceAll(thinedshell,allwants)
	thickned.Dispose()
	thinedshell.Dispose()
	for x in fixedexploded:
		x.Dispose()
	return finalresult

def framesv1(surfs,bord,borw):
	frames = []
	thicken = dg.Surface.Thicken(surfs,bord)
	exploded = dg.Geometry.Explode(thicken)[2:]
	joined = joinsurfs(exploded)
	prejointhicken = []
	for j in joined:
		prejointhicken.append(dg.Surface.Thicken(j,-borw,False))
	unioned = dg.Solid.ByUnion(prejointhicken)
	for x in exploded:
		x.Dispose()
	for j in joined:
		j.Dispose()
	thicken.Dispose()
	for j in prejointhicken:
		j.Dispose()
	return unioned

def framesv3(surfs,bord,borw):
	frames = []
	try:
		thicken = dg.Surface.Thicken(surfs,bord)
	except:
		permpan = dg.PolyCurve.ByJoinedCurves(surfs.PerimeterCurves())
		patchedpan = dg.Surface.ByPatch(permpan)
		thicken = dg.Surface.Thicken(patchedpan,bord,True)
		permpan.Dispose()
	exploded = dg.Geometry.Explode(thicken)[2:]
	thickenex = []
	for x in exploded:
		try:
			thickenex.append(dg.Surface.Thicken(x,borw*2,True))	
		except:
			pass
	s = patchedpan
	for int in thickenex:
		s = dg.Surface.SubtractFrom(s,int)[0]
	slisted = [s]
	inverse = dg.Surface.Difference(patchedpan,slisted)
	return inverse,thickenex

def joinsurfs(surfs):
	def surf_doesinter(a,b,tollerance = 0.00001):
		if round(dg.Geometry.DistanceTo(a,b),2) < tollerance:
			return True
		else:
			return False
	surfacesflatten = flatten(surfs)
	surfacesflatten = [x for x in surfacesflatten if x]
	if surfacesflatten != None and surfacesflatten != []:
		crvs = flatten(tolist(surfs))
		crvGroup = [-1 for x in range(len(crvs))]
		crvGroup[0] = 0
		maxGroupNum = 1
		for i in range(len(crvs)):
			if (crvGroup[i] == -1):
				crvGroup[i] = i
			for j in range(len(crvs)):
				try:
					if i != j and surf_doesinter(crvs[i], crvs[j]):
						if (crvGroup[j] == -1):
							crvGroup[j] = crvGroup[i]
						elif (crvGroup[i] != crvGroup[j]):
							oldNum = crvGroup[j]
							for k in range(len(crvs)):
								if (crvGroup[k] == oldNum):
									crvGroup[k] = crvGroup[i]
				except:
					pass
		groups = []
		excluded = []
		for n in crvGroup:
			innercount = 0
			tmp = []
			for n2 in crvGroup:
				if n == n2 and n2 not in excluded:
					tmp.append(crvs[innercount])
				innercount += 1
			if len(tmp) == 0:
				continue
			try:
				tmp = dg.Surface.ByUnion(tmp)
				groups.append(tmp)
			except:
				try:
					tmp = dg.PolySurface.ByJoinedSurfaces(tmp)
					groups.append(tmp)
				except:
					for t in tmp:
						groups.append(t)
			excluded.append(n)
		joinedsurfs = groups
		return joinedsurfs
	else:
		return surfs

def flatten(x):
    result = []
    for el in x:
        if hasattr(el, "__iter__") and not isinstance(el, basestring):
            result.extend(flatten(el))
        else:
            result.append(el)
    return result

def surfacesubtract(surf,solids,isplanar=None):
	solids = tolist(solids)
	if isplanar != None:
		isplanar = tolist(isplanar)
		if all(isplanar) == True:
			try:
				tryunion = dg.Solid.ByUnion(solids)
				solids = [tryunion]
			except:
				pass
	result = []
	s = surf
	s = trysoliddif(s,solids)
	try:
		slistedexplode = dg.Geometry.Explode(s)
		inverse = dg.Surface.Difference(surf,slistedexplode)
	except:
		sfixed = []
		exploded = slistedexplode
		areas = []
		for i in exploded:
			areas.append(i.Area)
		maxarea = max(areas)
		counter = 0
		for a in areas:
			if maxarea == a:
				wantedsurf = exploded[counter]
				break
			counter += 1
		sfixed.append(wantedsurf)
		try:
			inverse = dg.Surface.Difference(surf,sfixed)
		except:
			inverse = None
	try:
		explodedS = dg.Geometry.Explode(s)
		areasS = []
		for i in explodedS:
			areasS.append(i.Area)
		maxarea = max(areasS)
		counter = 0
		for a in areasS:
			if maxarea == a:
				s = explodedS[counter]
				break
			counter += 1
	except:
		pass
	return s,inverse

def operateframes(surfs,bord,borw):
	subtractedlist = []
	inversedlist = []
	for s in surfs:
		try:
			already = False
			danger = False
			try:
				solidframe = framesv1(s,bord,borw)
			except:
				solidframe = framesv2(s,bord,borw)
				danger = True
			if solidframe == None and danger == False:
				solidframe = framesv2(s,bord,borw)
				already = True
			subtract = surfacesubtract(s,solidframe)
			subtracted = subtract[0]
			inversed = subtract[1]
			subtractedlist.append(subtracted)
			inversedlist.append(inversed)
		except:
			try:
				if already == False:
					solidframe = framesv2(s,bord,borw)
					subtract = surfacesubtract(s,solidframe)
					subtracted = subtract[0]
					inversed = subtract[1]
					subtractedlist.append(subtracted)
					inversedlist.append(inversed)
				else:
					subtractedlist.append(s)
					inversedlist.append(None)
			except:
				try:
					solidframe = framesv3(s,bord,borw)
					sf = s
					for int in solidframe[1]:
						try:
							testifwork = dg.Surface.SubtractFrom(sf,int)
							if len(testifwork) != 0:
								sf = testifwork[0]
						except:
							pass
					subtractedlist.append(sf)
					inversedlist.append(solidframe[0])
				except:
					subtractedlist.append(s)
					inversedlist.append(None)
		try:
			solidframe.Dispose()
		except:
			pass
	return subtractedlist,inversedlist

def trythicken(poly,thickness,offset = 0):
	offsetpoly = tryoffset(poly,offset)
	try:
		solid = dg.Surface.Thicken(offsetpoly,thickness,True)
	except:
		solids = []
		extracted = dg.Geometry.Explode(poly)
		for e in extracted:
			e = tryoffset(e,offset)
			try:
				solids.append(dg.Surface.Thicken(e,thickness,True))
			except:
				try:
					permpan = dg.PolyCurve.ByJoinedCurves(e.PerimeterCurves())
					patchedpan = dg.Surface.ByPatch(permpan)
					solids.append(dg.Surface.Thicken(patchedpan,thickness,True))
					permpan.Dispose()
					patchedpan.Dispose()
				except:
					pass
		try:
			solid = dg.Solid.ByUnion(solids)
			for s in solids:
				s.Dispose()
		except:
			solid = solids
	return solid

def trysoliddif(surf,solidsstovoid):
	s = surf
	failed = []
	for int in solidsstovoid:
		try:
			testifwork = dg.Surface.SubtractFrom(s,int)
			if len(testifwork) != 0:
				s = testifwork[0]
			else:
				failed.append(int)
		except:
			failed.append(int)
	if len(failed) != 0:
		resfail = []
		for f in failed:
			resfail.append(dg.Geometry.Intersect(surf,f))
		resfail = flatten(resfail)
		try:
			for sone in resfail:
				s = dg.Surface.Difference(s,[sone])
		except:
			pass
	return s

def tryoffset(surf,offset):
	try:
		if offset != 0:
			surf = dg.Surface.Offset(surf,offset)
	except:
		pass
	return surf

def tryunion(flattenedsolids):
	if len(flattenedsolids) > 1:
		solids = [x for x in flattenedsolids if x]
		if len(solids) > 1:
			pass
		else:
			return flattenedsolids
		unioned = [solids[0]]
		solids = solids[1:]
		for s in solids:
			i = 0
			unionDone = False
			while i < len(unioned):
				try:
					unioned[i] = unioned[i].Union(s)
					unionDone = True
					break
				except:	i += 1
			if not unionDone: unioned.append(s)
		try:
			for f in flattenedsolids:
				f.Dispose()
		except:
			pass
		return unioned
	else:
		return flattenedsolids

msg = "Please Update Revit/Dynamo"
title = "AECedx - Karam"
alert = TaskDialog
script = Dynamo.Applications.DynamoRevit().RevitDynamoModel.CurrentWorkspace.FileName.split("\\")[-1]
version = Dynamo.Applications.DynamoRevit().RevitDynamoModel.Version
tranversion = version.split(".")[0:2]
numversion = ".".join(tranversion)

if LooseVersion(numversion) < LooseVersion("2.3"):
	if IN[0] != None and IN[0] != []:
		OUT = alert.Show(title, msg)
else:
	operate = operateframes(surfs,safethickfactor/2.0,borw)
	subtractedlist = operate[0]
	inversedlist = operate[1]
	if onlysubs == True:
		OUT = subtractedlist,inversedlist
	else:
		fixedinvertedlist = []
		for inv in inversedlist:
			if inv != None:
				fixedinvertedlist.append(dg.Geometry.Explode(inv))
				inv.Dispose()
		thickframes = []
		if len(fixedinvertedlist) != 0:
			fixedinvertedlist = flatten(fixedinvertedlist)
			joinedframes = joinsurfs(fixedinvertedlist)
			for joi in joinedframes:
				try:
					thickframes.append(trythicken(joi,bord))
				except:
					pass
				joi.Dispose()
			for fi in fixedinvertedlist:
				fi.Dispose()
		OUT = thickframes,inversedlist
# ----------------------------------------
code_block = CodeBlock(a=python_script) { a[0]; }
VARFrameSolids = Output(code_block)
code_block_2 = CodeBlock(a=python_script) { a[1]; }
VARExtraFrameOnly = Output(code_block_2)
