# Dynamo custom node K-Plan Function.dyf (Dynamo 2.13.1.3887)
# category: Synthesize.Automate.Views
# K-Plan
# packages: Synthesize toolkit 12.6.3

VARView = Input(VARView: var[]..[])
VARRotationDegree = Input(VARRotationDegree: var[]..[])
turnIntoList = Custom[CW.TurnIntoList](VARunknownItem=VARRotationDegree)  # package Synthesize toolkit; Turns an element (or a nested list) into a flat list
VARAxisLine = Input(VARAxisLine: var[]..[])
curves = Element.Curves(element=VARAxisLine)
startPoint = Curve.StartPoint(curve=curves)
endPoint = Curve.EndPoint(curve=curves)
rotate_crop_region = Python(IN[0]=VARView)  # IronPython2
# ---------- rotate_crop_region.python (54 lines) ----------
import clr
clr.AddReference('ProtoGeometry')
from Autodesk.DesignScript.Geometry import *

# Import DocumentManager and TransactionManager
clr.AddReference("RevitServices")
import RevitServices
from RevitServices.Persistence import DocumentManager
from RevitServices.Transactions import TransactionManager
# EXTENSION Enable ToDSType
clr.AddReference('RevitNodes')
import Revit
clr.ImportExtensions(Revit.Elements)

# Import RevitAPI
clr.AddReference("RevitAPI")
import Autodesk
from Autodesk.Revit.DB import *

# EXTENSION Enable Geometry Conversion Methods
clr.ImportExtensions(Revit.GeometryConversion)

doc = DocumentManager.Instance.CurrentDBDocument
uiapp = DocumentManager.Instance.CurrentUIApplication
app = uiapp.Application

from System.Collections.Generic import *

# Import ToDSType(bool) extension method
clr.AddReference("RevitNodes")
import Revit
clr.ImportExtensions(Revit.Elements)

views = (UnwrapElement(IN[0]))


TransactionManager.Instance.ForceCloseTransaction()
tGroup = TransactionGroup(doc, "Temp to find crop box element")
tGroup.Start()
trans1 = Transaction(doc, "Temp to find crop box element")
trans1.Start()
views.CropBoxVisible = False
trans1.Commit()
	
shownElems = FilteredElementCollector(doc, views.Id).ToElementIds()
	
trans1.Start()
views.CropBoxVisible = True
trans1.Commit()
	
cropBoxElement = FilteredElementCollector(doc, views.Id).Excluding(shownElems).FirstElement()
tGroup.RollBack()

OUT = cropBoxElement
# ----------------------------------------
end = Revit.Transaction.Transaction.End(input=rotate_crop_region)
rotate_crop_region_2 = Python(IN[0]=VARView, IN[1]=turnIntoList, IN[2]=startPoint, IN[3]=endPoint, IN[4]=end)  # IronPython2
# ---------- rotate_crop_region_2.python (49 lines) ----------
import clr
clr.AddReference('ProtoGeometry')
from Autodesk.DesignScript.Geometry import *

# Import DocumentManager and TransactionManager
clr.AddReference("RevitServices")
import RevitServices
from RevitServices.Persistence import DocumentManager
from RevitServices.Transactions import TransactionManager
# EXTENSION Enable ToDSType
clr.AddReference('RevitNodes')
import Revit
clr.ImportExtensions(Revit.Elements)

# Import RevitAPI
clr.AddReference("RevitAPI")
import Autodesk
from Autodesk.Revit.DB import *

# EXTENSION Enable Geometry Conversion Methods
clr.ImportExtensions(Revit.GeometryConversion)

doc = DocumentManager.Instance.CurrentDBDocument
uiapp = DocumentManager.Instance.CurrentUIApplication
app = uiapp.Application

from System.Collections.Generic import *

# Import ToDSType(bool) extension method
clr.AddReference("RevitNodes")
import Revit
clr.ImportExtensions(Revit.Elements)

views = (UnwrapElement(IN[0]))
angle = (UnwrapElement(IN[1]))
p1 = (UnwrapElement(IN[2]))
p2 = (UnwrapElement(IN[3]))
cropBoxElement = (UnwrapElement(IN[4]))

TransactionManager.Instance.EnsureInTransaction(doc)
count = 0
for each in angle:
	c1 = p1[count].ToXyz()
	c2 = p2[count].ToXyz()
	ElementTransformUtils.RotateElement(doc, cropBoxElement.Id, Line.CreateBound(c1, c2), each*0.0174533)
	count = count + 1
TransactionManager.Instance.TransactionTaskDone()
	
OUT = views
# ----------------------------------------
VARView_2 = Output(VARView)  # "VARView"
