# Dynamo custom node K-Rig Family.dyf (Dynamo 2.1.0.7500)
# category: Synthesize.Automate.Family
# K-Rig Family

VARFamilyInstance = Input(VARFamilyInstance: var[]..[])
VARAdaptiveMode = Input(VARAdaptiveMode: bool = false)
VARFamilyTemplate = Input(VARFamilyTemplate: var[]..[])
VARAdaptiveFamilyTemplate = Input(VARAdaptiveFamilyTemplate: var[]..[])
VARHeightInstanceParameter = Input(VARHeightInstanceParameter: bool = true)
VAROverwriteParameters = Input(VAROverwriteParameters: bool = true)
VARSeparators = Input(VARSeparators: string = "_")
VARInitialHostWidth = Input(VARInitialHostWidth: double = 0)
VARForceWorkPlaneBased = Input(VARForceWorkPlaneBased: bool = false)
VARSafeHeight = Input(VARSafeHeight: double = 0)
VARAdditiveSafeHeight = Input(VARAdditiveSafeHeight: bool = true)
python_script = Python(IN[0]=VARFamilyInstance, IN[1]=VARAdaptiveMode, IN[2]=VARFamilyTemplate, IN[3]=VARAdaptiveFamilyTemplate, IN[4]=VARHeightInstanceParameter, IN[5]=VAROverwriteParameters, IN[6]=VARSeparators, IN[7]=VARInitialHostWidth, IN[8]=VARForceWorkPlaneBased, IN[9]=VARSafeHeight, IN[10]=VARAdditiveSafeHeight)
# ---------- python_script.python (1005 lines) ----------
# Proudly created by Karam Baki: karam@aecedx.com

# Import crl
import clr

# IMPORTANT : ALL DYNAMO DESIGN SCRIPT NODES ARE AS (dg)
clr.AddReference('ProtoGeometry')
from Autodesk.DesignScript import Geometry as dg

# Enable Revit API
clr.AddReference('RevitAPI')
from Autodesk.Revit.DB import *

# Enable ToDSType
clr.AddReference('RevitNodes')
import Revit

# Enable Geometry Conversion Methods
clr.ImportExtensions(Revit.GeometryConversion)

# Enable DocumentManager and TransactionManager
clr.AddReference('RevitServices')
from RevitServices.Persistence import DocumentManager
from RevitServices.Transactions import TransactionManager

# Enable Revit UI
clr.AddReference("RevitAPIUI")
from Autodesk.Revit.UI import TaskDialog

# Import os
clr.AddReference("System")
import System
import sys
pf_path = System.Environment.GetFolderPath(System.Environment.SpecialFolder.ProgramFilesX86)
sys.path.append('%s\IronPython 2.7\Lib' %pf_path)
import os
import re

# Enable ICollection List Translate
clr.AddReference("System")
import System.Collections.Generic
from System.Collections.Generic import List

# Family Load Options Class
class FamOpt1(IFamilyLoadOptions):
	def __init__(self):
		pass
	def OnFamilyFound(self,familyInUse, overwriteParameterValues):
		overwriteParameterValues.Value = True
		return True
	def OnSharedFamilyFound(self,familyInUse, source, overwriteParameterValues):
		overwriteParameterValues.Value = True
		return True

# Family Load Options Class - Without Overwriting Parameters
class FamOptWithout(IFamilyLoadOptions):
	def __init__(self):
		pass
	def OnFamilyFound(self,familyInUse, overwriteParameterValues):
		overwriteParameterValues.Value = False
		return True
	def OnSharedFamilyFound(self,familyInUse, source, overwriteParameterValues):
		overwriteParameterValues.Value = False
		return True

# Simple Warning Swallow Class
class WarnSwallowSimple(IFailuresPreprocessor):
	def PreprocessFailures(self, failuresAccessor):
		failuresAccessor.DeleteAllWarnings()
		return FailureProcessingResult.Continue

tmpscale = "Height_Scale"
finalscale = "Adaptive_Scale"

def transferunit(famdoc):
	if int(DocumentManager.Instance.CurrentUIApplication.Application.VersionNumber) < 2021:
		unit = famdoc.GetUnits()
		currectformat = projectdoc.GetUnits().GetFormatOptions(UnitType.UT_Length)
		accuracy = currectformat.Accuracy
		unit.SetFormatOptions(UnitType.UT_Length,FormatOptions(currectformat.DisplayUnits,accuracy))
		famdoc.SetUnits(unit)
	else:
		unit = famdoc.GetUnits()
		currectformat = projectdoc.GetUnits().GetFormatOptions(SpecTypeId.Length)
		unit.SetFormatOptions(SpecTypeId.Length,currectformat)
		famdoc.SetUnits(unit)

def adaptiveop(doc,famsymboltoplace,isInstance,tmpscale,finalscale):
	pt = doc.FamilyCreate.NewReferencePoint(XYZ.Zero)
	parms = pt.GetOrderedParameters()
	for par in parms:
		name =  par.Definition.Name
		if name == "Point":
			par.Set(1)
			break
	parms = pt.GetOrderedParameters()
	for par in parms:
		name =  par.Definition.Name
		if name == "Orients to":
			par.Set(2)
			break
	plane = pt.GetCoordinatePlaneReferenceXY()
	ptonplane = app.Create.NewPointOnPlane(plane,UV(),UV(),0)
	refpt1 = doc.FamilyCreate.NewReferencePoint(ptonplane)
	
	plane = refpt1.GetCoordinatePlaneReferenceXZ()
	ptonplane = app.Create.NewPointOnPlane(plane,UV(),UV(),0)
	refpt2 = doc.FamilyCreate.NewReferencePoint(ptonplane)
	
	plane = refpt2.GetCoordinatePlaneReferenceXZ()
	ptonplane = app.Create.NewPointOnPlane(plane,UV(),UV(),0)
	refpt3 = doc.FamilyCreate.NewReferencePoint(ptonplane)
	
	plane = refpt3.GetCoordinatePlaneReferenceXZ()
	ptonplane = app.Create.NewPointOnPlane(plane,UV(),UV(),0)
	refpt4 = doc.FamilyCreate.NewReferencePoint(ptonplane)
	
	plane = refpt4.GetCoordinatePlaneReferenceXZ()
	ptonplane = app.Create.NewPointOnPlane(plane,UV(),UV(),0)
	refpt5 = doc.FamilyCreate.NewReferencePoint(ptonplane)
	
	plane = refpt5.GetCoordinatePlaneReferenceXZ()
	ptonplane = app.Create.NewPointOnPlane(plane,UV(),UV(),0)
	refpt6 = doc.FamilyCreate.NewReferencePoint(ptonplane)
	
	plane = refpt6.GetCoordinatePlaneReferenceXZ()
	ptonplane = app.Create.NewPointOnPlane(plane,UV(),UV(),0)
	refpt7 = doc.FamilyCreate.NewReferencePoint(ptonplane)
	
	getscale = False
	getscalenum = False
	getself = False
	getX = False
	getY = False
	getXoffset = False
	getYoffset = False
	getZoffset = False
	try:P_Scale = doc.FamilyManager.AddParameter(tmpscale,BuiltInParameterGroup.PG_GEOMETRY,ParameterType.Length,isInstance)
	except:getscale = True
	try:P_ScaleNum = doc.FamilyManager.AddParameter(finalscale,BuiltInParameterGroup.PG_GEOMETRY,ParameterType.Number,isInstance)
	except:getscalenum = True
	try:P_rotself = doc.FamilyManager.AddParameter("Adaptive_Rotate Self",BuiltInParameterGroup.PG_GEOMETRY,ParameterType.Angle,isInstance)
	except:getself = True
	try:P_rotX = doc.FamilyManager.AddParameter("Adaptive_Rotate X",BuiltInParameterGroup.PG_GEOMETRY,ParameterType.Angle,isInstance)
	except:getX = True
	try:P_rotY = doc.FamilyManager.AddParameter("Adaptive_Rotate Y",BuiltInParameterGroup.PG_GEOMETRY,ParameterType.Angle,isInstance)
	except:getY = True	
	try:P_offsetX = doc.FamilyManager.AddParameter("Adaptive_Offset X",BuiltInParameterGroup.PG_GEOMETRY,ParameterType.Length,isInstance)
	except:getXoffset = True
	try:P_offsetY = doc.FamilyManager.AddParameter("Adaptive_Offset Y",BuiltInParameterGroup.PG_GEOMETRY,ParameterType.Length,isInstance)
	except:getYoffset = True
	try:P_offsetZ = doc.FamilyManager.AddParameter("Adaptive_Offset Z",BuiltInParameterGroup.PG_GEOMETRY,ParameterType.Length,isInstance)
	except:getZoffset = True
	
	if getscale == True or getself == True or getX == True or getY == True:
		allparms = doc.FamilyManager.Parameters
		for a in allparms:
			pass
			pname = a.Definition.Name
			if pname == tmpscale and getscale == True:
				P_Scale = a
				if isInstance:
					doc.FamilyManager.MakeInstance(P_Scale)
				else:
					doc.FamilyManager.MakeType(P_Scale)
			if pname == finalscale and getscalenum == True:
				P_ScaleNum = a
				if isInstance:
					doc.FamilyManager.MakeInstance(P_ScaleNum)
				else:
					doc.FamilyManager.MakeType(P_ScaleNum)
			if pname == "Adaptive_Rotate Self" and getself == True:
				P_rotself = a
				if isInstance:
					doc.FamilyManager.MakeInstance(P_rotself)
				else:
					doc.FamilyManager.MakeType(P_rotself)
			if pname == "Adaptive_Rotate X" and getX == True:
				P_rotX = a
				if isInstance:
					doc.FamilyManager.MakeInstance(P_rotX)
				else:
					doc.FamilyManager.MakeType(P_rotX)
			if pname == "Adaptive_Rotate Y" and getY == True:
				P_rotY = a
				if isInstance:
					doc.FamilyManager.MakeInstance(P_rotY)
				else:
					doc.FamilyManager.MakeType(P_rotY)
			if pname == "Adaptive_Offset X" and getXoffset == True:
				P_offsetX = a
				if isInstance:
					doc.FamilyManager.MakeInstance(P_offsetX)
				else:
					doc.FamilyManager.MakeType(P_offsetX)
			if pname == "Adaptive_Offset Y" and getYoffset == True:
				P_offsetY = a
				if isInstance:
					doc.FamilyManager.MakeInstance(P_offsetY)
				else:
					doc.FamilyManager.MakeType(P_offsetY)
			if pname == "Adaptive_Offset Z" and getZoffset == True:
				P_offsetZ = a
				if isInstance:
					doc.FamilyManager.MakeInstance(P_offsetZ)
				else:
					doc.FamilyManager.MakeType(P_offsetZ)
					
	parms = refpt1.GetOrderedParameters()
	for e in parms:
		pname = e.Definition.Name
		if pname == "Rotation Angle":
			rotparm1 = e
		if pname == "Offset":
			offparm1 = e
	
	parms = refpt2.GetOrderedParameters()
	for e in parms:
		pname = e.Definition.Name
		if pname == "Rotation Angle":
			rotparm2 = e
		if pname == "Offset":
			offparm2 = e
			
	parms = refpt3.GetOrderedParameters()
	for e in parms:
		pname = e.Definition.Name
		if pname == "Rotation Angle":
			rotparm3 = e
		if pname == "Offset":
			offparm3 = e
			
	parms = refpt4.GetOrderedParameters()
	for e in parms:
		pname = e.Definition.Name
		if pname == "Rotation Angle":
			rotparm4 = e
		if pname == "Offset":
			offparm4 = e
			
	parms = refpt5.GetOrderedParameters()
	for e in parms:
		pname = e.Definition.Name
		if pname == "Rotation Angle":
			rotparm5 = e
		if pname == "Offset":
			offparm5 = e
			
	parms = refpt6.GetOrderedParameters()
	for e in parms:
		pname = e.Definition.Name
		if pname == "Rotation Angle":
			rotparm6 = e
		if pname == "Offset":
			offparm6 = e
			
	parms = refpt7.GetOrderedParameters()
	for e in parms:
		pname = e.Definition.Name
		if pname == "Rotation Angle":
			rotparm7 = e
		if pname == "Offset":
			offparm7 = e
			
	try:doc.FamilyManager.AssociateElementParameterToFamilyParameter(rotparm7,P_rotself)
	except:pass
	try:doc.FamilyManager.AssociateElementParameterToFamilyParameter(rotparm5,P_rotX)
	except:pass
	try:doc.FamilyManager.AssociateElementParameterToFamilyParameter(rotparm6,P_rotY)
	except:pass
	try:doc.FamilyManager.AssociateElementParameterToFamilyParameter(offparm3,P_offsetX)
	except:pass
	try:doc.FamilyManager.AssociateElementParameterToFamilyParameter(offparm2,P_offsetY)
	except:pass
	try:doc.FamilyManager.AssociateElementParameterToFamilyParameter(offparm1,P_offsetZ)
	except:pass
	
	reference = refpt7.GetCoordinatePlaneReferenceXY()
	placedfam = doc.FamilyCreate.NewFamilyInstance(reference,XYZ.Zero,XYZ.Zero,famsymboltoplace)
	
	parms = famsymboltoplace.GetOrderedParameters()
	for e in parms:
		pname = e.Definition.Name
		if pname == tmpscale:
			scaleparm = e
	try:doc.FamilyManager.AssociateElementParameterToFamilyParameter(scaleparm,P_Scale)
	except:pass
	doc.FamilyManager.Set(P_ScaleNum, 1)
	doc.FamilyManager.SetFormula(P_Scale,finalscale + "*1")
	reordered  = []
	reordered.append(P_ScaleNum)
	reordered.append(P_rotself)
	reordered.append(P_rotX)
	reordered.append(P_rotY)
	reordered.append(P_offsetX)
	reordered.append(P_offsetY)
	reordered.append(P_offsetZ)
	reordered.append(P_Scale)
	ttt = []
	allparms = doc.FamilyManager.Parameters
	for a in allparms:
		na = a.Definition.Name
		if na == tmpscale or na == finalscale or na == "Adaptive_Rotate Self" or na == "Adaptive_Rotate X" or na == "Adaptive_Rotate Y" or na == "Adaptive_Offset X" or na == "Adaptive_Offset Y" or na == "Adaptive_Offset Z":
			pass
		else:
			reordered.append(a)
	doc.FamilyManager.ReorderParameters(List[FamilyParameter](reordered))
	return placedfam

# Detect Upper Mid Point
def midupperpoint(doc,elem):
	doc.Regenerate()
	bbox = elem.get_BoundingBox(None)
	minp = bbox.Min.ToPoint()
	maxp = bbox.Max.ToPoint()
	fixedminp = dg.Point.ByCoordinates(minp.X,minp.Y,maxp.Z)
	midP = dg.Curve.PointAtParameter(dg.Line.ByStartPointEndPoint(maxp,fixedminp),0.5)
	return midP

# Detect Upper Mid Point
def middownerpoint(doc,elem):
	doc.Regenerate()
	bbox = elem.get_BoundingBox(None)
	minp = bbox.Min.ToPoint()
	maxp = bbox.Max.ToPoint()
	fixedmaxp = dg.Point.ByCoordinates(maxp.X,maxp.Y,minp.Z)
	midP = dg.Curve.PointAtParameter(dg.Line.ByStartPointEndPoint(fixedmaxp,minp),0.5)
	return midP

# Dump External Definition Create
def exdef(param_name,param_guid,param_type,uiapp):
	app = uiapp.Application
	originalfile = uiapp.Application.SharedParametersFilename
	temp_path = System.IO.Path.GetTempPath()
	temp_file = temp_path + "Karam_Temp_Shared.txt"
	open(temp_file, 'a').close()
	uiapp.Application.SharedParametersFilename = temp_file
	definition_file = app.OpenSharedParameterFile()
	try:
		definition_file.Groups.Create("Karam Group")
	except:
		pass
	definition_groups = definition_file.Groups
	for group in definition_groups:
		ops = ExternalDefinitionCreationOptions(param_name, param_type)
		ops.GUID = param_guid
		try:
			group.Definitions.Create(ops)
		except:
			pass
	exdef = list(list(definition_groups)[0].Definitions)[0]
	return exdef,originalfile,temp_file

# Simple Flatten
def flatten(x):
    result = []
    for el in x:
        if hasattr(el, "__iter__") and not isinstance(el, basestring):
            result.extend(flatten(el))
        else:
            result.append(el)
    return result

# Draw Invisible Line If Needed
def invline(doc,elem,autoheight,distance):
	if autoheight:
		p1 = midupperpoint(doc,elem)
		p1 = dg.Point.ByCoordinates(p1.X,p1.Y,p1.Z + distance/2.0)
		p2 = middownerpoint(doc,elem)
		p2 = dg.Point.ByCoordinates(p2.X,p2.Y,p2.Z - distance/2.0)
	else:
		p1 = midupperpoint(doc,elem)
		p2 = dg.Point.ByCoordinates(p1.X,p1.Y,distance/2.0)
		p1 = dg.Point.ByCoordinates(p1.X,p1.Y,-distance/2.0)
	revitline = Line.CreateBound(p1.ToXyz(),p2.ToXyz())
	tmp_plane = dg.Plane.ByOriginNormal(p1,dg.Vector.XAxis())
	skp = SketchPlane.Create(doc,tmp_plane.ToPlane())
	modline = doc.FamilyCreate.NewModelCurve(revitline,skp)
	modline.LineStyle = [x for x in FilteredElementCollector(doc).OfClass(GraphicsStyle) if x.Name.lower() == "<invisible lines>"][0]
	return modline

# Get Maximum Height In Family
def maxfamheight(projectdoc,famdoc,autoheight = True,safeheight = 0):
	if autoheight or safeheight == 0:
		elements = []
		collector = FilteredElementCollector(famdoc).WhereElementIsNotElementType().ToElements()
		opt = Options()
		for c in collector:
			if (c.get_Parameter(BuiltInParameter.IS_VISIBLE_PARAM) or c.get_Parameter(BuiltInParameter.ELEMENT_IS_CUTTING)) and "line" not in c.ToString().lower() and "region" not in c.ToString().lower() and "curve" not in c.ToString().lower():
				try:
					if c.get_Parameter(BuiltInParameter.IS_VISIBLE_PARAM).AsInteger() == 0:
						continue
				except:
					pass
				try:
					status = c.get_Parameter(BuiltInParameter.ELEMENT_IS_CUTTING).AsInteger()
					if status == 0:
						elements.append(c)
				except:
					elements.append(c)
		if famdoc.OwnerFamily.get_Parameter(BuiltInParameter.FAMILY_HOSTING_BEHAVIOR).AsValueString() == "Face":
			count = 0
			for e in elements:
				if e.ToString() == "Autodesk.Revit.DB.Extrusion":
					elements.pop(count)
					break
				count += 1
		result = []
		minpts = []
		maxpts = []
		pts = []
		pX = []
		pY = []
		pZ = []
		for e in elements:
			try:
				bb = e.get_BoundingBox(None)
				minp = bb.Min
				maxp = bb.Max
				tmpP = []
				tmpP.append(minp)
				tmpP.append(maxp)
				pts.append(tmpP)
				for p in tmpP:
					pX.append(p.X)
					pY.append(p.Y)
					pZ.append(p.Z)
			except:
				pass
		if len(pX) > 0:
			MAX_X = max(pX)
			MAX_Y = max(pY)
			MAX_Z = max(pZ)
			MIN_Z = min(pZ)
			p1 = XYZ(MAX_X,MAX_Y,MAX_Z)
			p2 = XYZ(MAX_X,MAX_Y,MIN_Z)
			distance = p2.DistanceTo(p1)
		else:
			distance = 0
		if safeheight != 0:
			if int(DocumentManager.Instance.CurrentUIApplication.Application.VersionNumber) < 2021:
				safeheight = UnitUtils.ConvertToInternalUnits(safeheight,projectdoc.GetUnits().GetFormatOptions(UnitType.UT_Length).DisplayUnits)
			else:
				safeheight = UnitUtils.ConvertToInternalUnits(safeheight,projectdoc.GetUnits().GetFormatOptions(SpecTypeId.Length).GetUnitTypeId())
			return distance + safeheight
		else:
			return distance
	else:
		if int(DocumentManager.Instance.CurrentUIApplication.Application.VersionNumber) < 2021:
			distance = UnitUtils.ConvertToInternalUnits(safeheight,projectdoc.GetUnits().GetFormatOptions(UnitType.UT_Length).DisplayUnits)
		else:
			distance = UnitUtils.ConvertToInternalUnits(safeheight,projectdoc.GetUnits().GetFormatOptions(SpecTypeId.Length).GetUnitTypeId())
		return distance

# Get Family Instance Information
def getinstanceinfo(sourceinstance):
	family = sourceinstance.Symbol.Family
	familyname = family.Name
	famtype = sourceinstance.Symbol
	famtypename = sourceinstance.Symbol.GetParameters("Type Name")[0].AsString()
	return family,familyname,famtype,famtypename

# Get ElementId or Value String
def bestparamvalue(famdoc,famtype,famparam):
	if famdoc == None and famtype == None:
		ParamValueString = famparam.AsElementId()
		if ParamValueString.ToString() == "-1":
			storagetype = str(famparam.StorageType)
			try:
				if storagetype == "Integer":
					ParamValueString = famparam.AsInteger()
				elif storagetype == "Double":
					ParamValueString = famparam.AsDouble()
				elif storagetype == "String":
					ParamValueString = famparam.AsString()
			except:
				ParamValueString = famparam.AsValueString()
		else:
			try:
				ParamValueString = famparam.AsValueString()
			except:
				ParamValueString = None
	else:
		ParamValueString = famtype.AsElementId(famparam)
		if ParamValueString.ToString() == "-1":
			storagetype = str(famparam.StorageType)
			try:
				if storagetype == "Integer":
					ParamValueString = famtype.AsInteger(famparam)
				elif storagetype == "Double":
					ParamValueString = famtype.AsDouble(famparam)
				elif storagetype == "String":
					ParamValueString = famtype.AsString(famparam)
			except:
				ParamValueString = famtype.AsValueString(famparam)
		else:
			try:
				if famdoc != None:
					ParamValueString = famdoc.GetElement(ParamValueString).Name
				else:
					ParamValueString = famtype.AsValueString(famparam)
			except:
				ParamValueString = famtype.AsValueString(famparam)
	return ParamValueString

# Get/Create Wanted Family Type
def getfamtype(famdoc,famtypename = None):
	alltypes = famdoc.FamilyManager.Types
	if len(list(alltypes)) == 1 or famtypename == None:
		famtype = famdoc.FamilyManager.CurrentType
	elif len(list(alltypes)) == 0 or famtypename == None:
		famtype = famdoc.FamilyManager.NewType(famtypename)
		famdoc.FamilyManager.CurrentType = famtype
	else:
		for t in alltypes:
			if t.Name == famtypename:
				famdoc.FamilyManager.CurrentType = t
				famtype = t
				break
	return famtype

# Get Batch Family Parameters Information Function
def famparaminfo(famparam,famdoc,famtype = None,toconsiderinfo = None):
	if famtype == None:
		famtype = famdoc.FamilyManager.CurrentType
	ParamName = famparam.Definition.Name
	if toconsiderinfo != None:
		for tocon in toconsiderinfo:
			if tocon[0] == ParamName:
				try:
					famdoc.FamilyManager.Set(famparam,tocon[1])
				except:
					try:
						famdoc.FamilyManager.SetValueString(famparam,tocon[1])
					except:
						pass
	is_shared = famparam.IsShared
	#if ParamName == "Height":
	#	ParamName = "Height_Original"
	ParamValueString = bestparamvalue(famdoc,famtype,famparam)
	if ParamValueString == None:
		try:
			ParamValueString = famtype.AsString(famparam)
		except:
			pass
	ParamType = famparam.Definition.ParameterType
	BuiltinParam = famparam.Definition.BuiltInParameter
	BuiltinGroup = famparam.Definition.ParameterGroup
	is_instance = famparam.IsInstance
	if is_shared:
		guid = famparam.GUID
	else:
		guid = None
	formula = famparam.Formula
	if formula == None:
		is_formuladefined = False
	else:
		is_formuladefined = True
	if len(list(famparam.AssociatedParameters)):
		is_associated = True
	else:
		is_associated = False
	return famparam,ParamValueString,ParamName,ParamType,BuiltinParam,BuiltinGroup,is_instance,is_shared,guid,formula,is_formuladefined,is_associated

# Get Batch Family Parameter Information
def getparaminfo(projectdoc,famdoc,famtype = None,toconsiderinfo = None,autoheight = True,safeheight = 0):
	if famtype == None:
		famtype = famdoc.FamilyManager.CurrentType
	allparams = list(famdoc.FamilyManager.GetParameters())
	info= []
	for famparam in allparams:
		batchinfo = famparaminfo(famparam,famdoc,famtype,toconsiderinfo)
		if str(batchinfo[3]) != "LoadClassification":
			info.append(batchinfo)
	tochecklater = []
	for i in info:
		if i[9] != None:
			splitted = i[9].Split(" ")
			tochecklater.append(splitted)
	tochecklater = flatten(tochecklater)
	important = []
	for i in info:
		name = i[2]
		if name in tochecklater or i[7] == True or i[3].ToString() == "Material":
			important.append(True)
		else:
			important.append(False)
	newinfo = []
	count = 0
	for im in important:
		currentinfo = info[count]
		count += 1
		tmp = []
		if im:
			if currentinfo[9] == None:
				#status = "Normal Importance"
				status = True
			else:
				#status = "Delayed Importance"
				status = True
			for i in currentinfo:
				tmp.append(i)
			tmp.append(status)
		else:
			for i in currentinfo:
				tmp.append(i)
			tmp.append(False)
		newinfo.append(tmp)
	count = 0
	maxheight = maxfamheight(projectdoc,famdoc,autoheight,safeheight)
	for i in newinfo:
		if i[2] == "Height" and i[4].ToString() == "RENDER_PLANT_HEIGHT":
			famdoc.FamilyManager.Set(i[0],maxheight)
			newinfo[count][1] = famtype.AsDouble(i[0])
			break
		count += 1
	try: isfam_shared = famdoc.OwnerFamily.get_Parameter(BuiltInParameter.FAMILY_SHARED).AsInteger()
	except: isfam_shared = 0
	try: isfam_workplane = famdoc.OwnerFamily.get_Parameter(BuiltInParameter.FAMILY_WORK_PLANE_BASED).AsInteger()
	except: isfam_workplane = 0
	try: isfam_vertical = famdoc.OwnerFamily.get_Parameter(BuiltInParameter.FAMILY_ALWAYS_VERTICAL).AsInteger()
	except: isfam_vertical = 0
	try: isfam_cuts = famdoc.OwnerFamily.get_Parameter(BuiltInParameter.FAMILY_ALLOW_CUT_WITH_VOIDS).AsInteger()
	except: isfam_cuts = 0
	famdoc.OwnerFamily.get_Parameter(BuiltInParameter.FAMILY_SHARED).Set(0)
	return newinfo,isfam_shared,isfam_workplane,isfam_vertical,isfam_cuts,maxheight

# Initial Family Instance Information
def initialop(projectdoc,sourceinstance,hostwidth,autoheight,safeheight):
	initialinfo = getinstanceinfo(sourceinstance)
	family = initialinfo[0]
	familyname = initialinfo[1]
	projectfamtype = initialinfo[2]
	famtypename = initialinfo[3]
	instanceparameters = sourceinstance.GetOrderedParameters()
	namesandvalues = []
	for ins in  instanceparameters:
		namesandvalues.append([ins.Definition.Name,bestparamvalue(None,None,ins)])
	TransactionManager.Instance.ForceCloseTransaction()
	famdoc = projectdoc.EditFamily(family)
	trans1 = Transaction(famdoc, 'Set Initial Height Parameter')
	trans1.Start()
	warnhandle = WarnSwallowSimple()
	foptions = trans1.GetFailureHandlingOptions()
	foptions.SetFailuresPreprocessor(warnhandle)
	trans1.SetFailureHandlingOptions(foptions)
	if famdoc.OwnerFamily.get_Parameter(BuiltInParameter.FAMILY_HOSTING_BEHAVIOR).AsValueString() == "Ceiling":
		isceiling = True
	else:
		isceiling = False
	if hostwidth != 0:
		try:
			all_walls = list(FilteredElementCollector(famdoc).OfCategory(BuiltInCategory.OST_Walls).WhereElementIsElementType())
			all_floors = list(FilteredElementCollector(famdoc).OfCategory(BuiltInCategory.OST_Floors).WhereElementIsElementType())
			all_roofs = list(FilteredElementCollector(famdoc).OfCategory(BuiltInCategory.OST_Roofs).WhereElementIsElementType())
			all_ceilings = list(FilteredElementCollector(famdoc).OfCategory(BuiltInCategory.OST_Ceilings).WhereElementIsElementType())
			host_types = all_walls + all_floors + all_roofs + all_ceilings
			thecompound = CompoundStructure.CreateSingleLayerCompoundStructure(MaterialFunctionAssignment.Structure,hostwidth,FilteredElementCollector(famdoc).OfClass(Material).FirstElementId())
			for host_type in host_types:
				host_type.SetCompoundStructure(thecompound)
		except:
			pass
	try:
		twolevelheight = projectdoc.GetElement(sourceinstance.get_Parameter(BuiltInParameter.FAMILY_TOP_LEVEL_PARAM).AsElementId()).Elevation - projectdoc.GetElement(sourceinstance.get_Parameter(BuiltInParameter.FAMILY_BASE_LEVEL_PARAM).AsElementId()).Elevation + sourceinstance.get_Parameter(BuiltInParameter.FAMILY_TOP_LEVEL_OFFSET_PARAM).AsDouble() - sourceinstance.get_Parameter(BuiltInParameter.FAMILY_BASE_LEVEL_OFFSET_PARAM).AsDouble()
		all_levels = list(FilteredElementCollector(famdoc).OfCategory(BuiltInCategory.OST_Levels).WhereElementIsNotElementType())
		if twolevelheight != None and len(all_levels) > 1:
			all_levels[-1].Elevation = twolevelheight
	except:
		pass
	originalcat = famdoc.OwnerFamily.FamilyCategory.Name
	famtype = getfamtype(famdoc,famtypename)
	allinfo = getparaminfo(projectdoc,famdoc,famtype,namesandvalues,autoheight,safeheight)
	trans1.Commit()
	paraminfo = allinfo[0]
	isfam_shared = allinfo[1]
	isfam_workplane = allinfo[2]
	isfam_vertical = allinfo[3]
	isfam_cuts = allinfo[4]
	maxheight = allinfo[5]
	typemark = projectfamtype.get_Parameter(BuiltInParameter.ALL_MODEL_TYPE_MARK).AsString()
	resultname = "K-Rigged" + separator + familyname + separator + famtypename
	return resultname,famdoc,paraminfo,isfam_shared,isfam_workplane,isfam_vertical,isfam_cuts,maxheight,originalcat,famtypename,typemark,isceiling

# Create New Family
def createfamily(fam_path,doc,uiapp,famname,famcategory,isShared,isWorkplane,isVertical,isCuts,maxheight,paraminfo,instance,initial):
	save_path = '%s%s.rfa' % (temp_path, re.sub(r'[\\/*?:"<>|]',"",famname))
	famdoc = doc.Application.NewFamilyDocument(fam_path)
	try:
		TransactionManager.Instance.ForceCloseTransaction()
		trans1 = Transaction(famdoc, 'New ' + famname + ' Family')
		trans1.Start()
		warnhandle = WarnSwallowSimple()
		foptions = trans1.GetFailureHandlingOptions()
		foptions.SetFailuresPreprocessor(warnhandle)
		trans1.SetFailureHandlingOptions(foptions)
		fam_cat = famdoc.Settings.Categories.get_Item(famcategory)
		famdoc.OwnerFamily.FamilyCategory = fam_cat
		try:
			famtype = famdoc.FamilyManager.NewType(famname)
			famdoc.FamilyManager.CurrentType = famtype
		except:
			pass
		if adaptivemode:
			transferunit(famdoc)
		for p in paraminfo:
			try:
				if p[2] != "Height_Scale":
					instatus = p[6]
				else:
					instatus = instance
				if p[7] == True:
					externaldefOP = exdef(p[2],p[8],p[3],uiapp)
					externaldef = externaldefOP[0]
					try:
						freshparam = famdoc.FamilyManager.AddParameter(externaldef,p[5],instatus)
					except:
						pass
					uiapp.Application.SharedParametersFilename = externaldefOP[1]
					os.remove(externaldefOP[2])
				else:
					freshparam = famdoc.FamilyManager.AddParameter(p[2],p[5],p[3],instatus)
			except:
				pass
			if p[2] == "Height" and (initial == "First" or initial == "Second"):
				freshparam = famdoc.FamilyManager.AddParameter("Height_Original",p[5],p[3],p[6])
				if p[1] != None:
					famdoc.FamilyManager.Set(freshparam,p[1])
		if famcategory != "Planting":
			try:
				famdoc.FamilyManager.AddParameter("Height_Scale",BuiltInParameterGroup.PG_GEOMETRY,ParameterType.Length,instance)
			except:
				pass
		parms = famdoc.FamilyManager.GetParameters()
		for epms in parms:
			pname = epms.Definition.Name
			if (pname == "Height" and famcategory == "Planting") or pname == "Height_Scale":
				famdoc.FamilyManager.Set(epms, maxheight)
		if isShared == True:
			try:famdoc.OwnerFamily.get_Parameter(BuiltInParameter.FAMILY_SHARED).Set(1)
			except:pass
		else:
			try:famdoc.OwnerFamily.get_Parameter(BuiltInParameter.FAMILY_SHARED).Set(0)
			except:pass
		if isWorkplane == True:
			try:famdoc.OwnerFamily.get_Parameter(BuiltInParameter.FAMILY_WORK_PLANE_BASED).Set(1)
			except:pass
		else:
			try:famdoc.OwnerFamily.get_Parameter(BuiltInParameter.FAMILY_WORK_PLANE_BASED).Set(0)
			except:pass
		if isVertical == True:
			try:famdoc.OwnerFamily.get_Parameter(BuiltInParameter.FAMILY_ALWAYS_VERTICAL).Set(1)
			except:pass
		else:
			try:famdoc.OwnerFamily.get_Parameter(BuiltInParameter.FAMILY_ALWAYS_VERTICAL).Set(0)
			except:pass
		if isCuts == True:
			try:famdoc.OwnerFamily.get_Parameter(BuiltInParameter.FAMILY_ALLOW_CUT_WITH_VOIDS).Set(1)
			except:pass
		else:
			try:famdoc.OwnerFamily.get_Parameter(BuiltInParameter.FAMILY_ALLOW_CUT_WITH_VOIDS).Set(0)
			except:pass
		trans1.Commit()
		famdoc.SaveAs(save_path, SaveAsOpt)
		loaded = famdoc
	except:
		try:
			trans1.Commit()
		except:
			pass
		TransactionManager.Instance.ForceCloseTransaction()
		try:famdoc.Close(False)
		except:pass
		try:doc.Close(False)
		except:pass
		try:System.IO.File.Delete(save_path)
		except:pass
		loaded = None
	return loaded,save_path

# Load Family
def loadOP(famdoc,doc,save_path,famtypename,paraminfo,initial,forceworkplane,isceiling,autoheight,safeheight,adaptivemode):
	try:
		if famdoc != None and doc != None:
			loaded = famdoc.LoadFamily(doc,FamOpt1())
			symbols = loaded.GetFamilySymbolIds().GetEnumerator()
			if famtypename != None:
				for t in symbols:
					telem = doc.GetElement(t)
					typename = telem.GetParameters("Type Name")[0].AsString()
					if typename == famtypename:
						symbol1 = doc.GetElement(t)
			else:
				symbols.MoveNext()
				symbol1 = doc.GetElement(symbols.Current)
			TransactionManager.Instance.ForceCloseTransaction()
			trans1 = Transaction(doc, 'Placing Family')
			trans1.Start()
			warnhandle = WarnSwallowSimple()
			foptions = trans1.GetFailureHandlingOptions()
			foptions.SetFailuresPreprocessor(warnhandle)
			trans1.SetFailureHandlingOptions(foptions)
			if forceworkplane == True and ((initial == "Second" and isceiling) or initial == "Last"):
				try:doc.OwnerFamily.get_Parameter(BuiltInParameter.FAMILY_WORK_PLANE_BASED).Set(1)
				except:pass
			if forceworkplane == True and initial == "Last":
				try:doc.OwnerFamily.get_Parameter(BuiltInParameter.FAMILY_ALWAYS_VERTICAL).Set(0)
				except:pass
			if not symbol1.IsActive: symbol1.Activate()
			newlyplaced = False
			if adaptivemode:
				newinstace = adaptiveop(doc,symbol1,instance,tmpscale,finalscale)
				newlyplaced = True
			else:
				try:
					if forceworkplane == True and (initial == "Last"):
						firstlevel = doc.GetElement(FilteredElementCollector(doc).OfCategory(BuiltInCategory.OST_Levels).WhereElementIsNotElementType().FirstElementId())
						newinstace = doc.FamilyCreate.NewFamilyInstance(Reference(firstlevel), XYZ.Zero, XYZ.Zero, symbol1)
					else:
						newinstace = doc.FamilyCreate.NewFamilyInstance(XYZ.Zero, symbol1, Structure.StructuralType.NonStructural)
					newlyplaced = True
				except:
					try:
						firstlevel = doc.GetElement(FilteredElementCollector(doc).OfCategory(BuiltInCategory.OST_Levels).WhereElementIsNotElementType().FirstElementId())
						newinstace = doc.FamilyCreate.NewFamilyInstance(XYZ.Zero, symbol1, firstlevel, Structure.StructuralType.NonStructural)
					except:
						newinstace = doc.GetElement(FilteredElementCollector(doc).OfCategoryId(symbol1.Category.Id).WhereElementIsNotElementType().FirstElementId())
					newlyplaced = True
			famtypeparams = list(symbol1.GetOrderedParameters()) + list(newinstace.GetOrderedParameters())
			allparams = list(doc.FamilyManager.GetParameters())
			for elemparm in famtypeparams:
				for famparam in allparams:
					if (elemparm.Definition.Name == "Height" and famparam.Definition.Name == "Height_Original" and initial == "First") or (elemparm.Definition.Name == famparam.Definition.Name and initial == "Second") or (elemparm.Definition.Name == famparam.Definition.Name and famparam.Definition.Name != "Height" and famparam.Definition.Name != "Height_Original" and initial == "First") or (elemparm.Definition.Name == "Height_Original" and famparam.Definition.Name == "Height" and initial == "Last") or (elemparm.Definition.Name == "Height" and famparam.Definition.Name == "Height_Scale" and initial == "Last") or (elemparm.Definition.Name == famparam.Definition.Name and elemparm.Definition.Name != "Height" and elemparm.Definition.Name != "Height_Original" and initial == "Last"):
						for p in paraminfo:
							if p[2] == famparam.Definition.Name:
								if p[3].ToString() == "Material":
									mat_fec = FilteredElementCollector(doc).OfClass(Material)
									for m in mat_fec:
										if m.Name.lower() == str(p[1]).lower():
											doc.FamilyManager.Set(famparam,m.Id)
								else:
									try:
										doc.FamilyManager.Set(famparam,p[1])
									except:
										try:
											doc.FamilyManager.SetValueString(famparam,p[1])
										except:
											pass
								try:
									if p[10]:
										doc.FamilyManager.SetFormula(famparam,p[9])
								except:
									pass
						try:
							doc.FamilyManager.AssociateElementParameterToFamilyParameter(elemparm,famparam)
						except:
							pass
			if newlyplaced and initial == "First" and isceiling:
				currentpt = newinstace.Location.Point
				newinstace.Location.Point = XYZ(currentpt.X,currentpt.Y,0)
			if newlyplaced and initial == "Last" and isceiling:
				newinstace.IsWorkPlaneFlipped = True
			if newlyplaced and initial == "First" and safeheight != 0:
				invline(doc,newinstace,autoheight,safeheight)		
			trans1.Commit()
			famdoc.Close(False)
			if save_path != None:
				System.IO.File.Delete(save_path)
			return "Loaded"
		else:
			return "ERROR"
	except:
		try:
			trans1.Commit()
		except:
			pass
		TransactionManager.Instance.ForceCloseTransaction()
		try:famdoc.Close(False)
		except:pass
		if save_path != None:
			System.IO.File.Delete(save_path)
		return "ERROR"

# Family Saving Options
SaveAsOpt = SaveAsOptions()
SaveAsOpt.OverwriteExistingFile = True
temp_path = System.IO.Path.GetTempPath()

# Initial Family Instance Info
sourceinstance = UnwrapElement(IN[0])
adaptivemode = IN[1]
fam_path = IN[2]
adapt_fam_path = IN[3]
instance = IN[4]
overwriteparameters = IN[5]
separator = IN[6]
hostwidth = IN[7]
forceworkplane = IN[8]
safeheight = IN[9]
autoheight = IN[10]

testBbox = sourceinstance.get_BoundingBox(None).ToProtoType()
if testBbox.MinPoint.Z - testBbox.MaxPoint.Z == 0:
	if safeheight == 0:
		safeheight = 1

# Project Document and UI
projectdoc = DocumentManager.Instance.CurrentDBDocument
uiapp = DocumentManager.Instance.CurrentUIApplication
app = uiapp.Application

# Convert Host Width to Internal Units
if int(DocumentManager.Instance.CurrentUIApplication.Application.VersionNumber) < 2021:
	hostwidth = UnitUtils.ConvertToInternalUnits(hostwidth,projectdoc.GetUnits().GetFormatOptions(UnitType.UT_Length).DisplayUnits)
else:
	hostwidth = UnitUtils.ConvertToInternalUnits(hostwidth,projectdoc.GetUnits().GetFormatOptions(SpecTypeId.Length).GetUnitTypeId())

try:
	# Getting Info From Initial Family
	initialOP = initialop(projectdoc,sourceinstance,hostwidth,autoheight,safeheight)
	
	# Familiy is Writable
	familywritable = True
except:
	# Familiy is Not Writable
	familywritable = False
	
	# Show Message
	OUT = TaskDialog.Show("AECedx - Karam", "Please Close The Opened Family")

# Check if Family is Writable
if familywritable:
	# Variables
	resultname = initialOP[0]
	initialfamdoc = initialOP[1]
	paraminfo = initialOP[2]
	isfam_shared = initialOP[3]
	isfam_workplane = initialOP[4]
	isfam_vertical = initialOP[5]
	isfam_cuts = initialOP[6]
	maxheight = initialOP[7]
	originalcat = initialOP[8]
	famtypename = initialOP[9]
	typemark = initialOP[10]
	isceiling = initialOP[11]
	
	# Check If Forced  Workplane
	if forceworkplane:
		isfam_workplane = True
	
	# Creating First Planting Family
	firstplantOP = createfamily(fam_path,initialfamdoc,uiapp,"First " + resultname,"Planting",False,False,False,False,maxheight,paraminfo,instance,"First")
	firstplantdoc = firstplantOP[0]
	firstplantsavepath = firstplantOP[1]
	
	# Load Initial to First Planting
	loadOP(initialfamdoc,firstplantdoc,None,famtypename,paraminfo,"First",forceworkplane,isceiling,autoheight,safeheight,False)
	
	# Creating Second Planting Family
	if adaptivemode:
		is_second_workplane = True
	else:
		is_second_workplane = False
	secondplantOP = createfamily(fam_path,initialfamdoc,uiapp,"Second " + resultname,"Planting",False,is_second_workplane,False,False,maxheight,paraminfo,instance,"Second")
	secondplantdoc = secondplantOP[0]
	secondplantsavepath = secondplantOP[1]
	
	# Load First to Second Planting
	loadOP(firstplantdoc,secondplantdoc,firstplantsavepath,None,paraminfo,"Second",forceworkplane,isceiling,autoheight,safeheight,False)
	
	if adaptivemode:
		fam_path = adapt_fam_path
	
	# Creating Final Family
	finalfamilyOP = createfamily(fam_path,initialfamdoc,uiapp,resultname,originalcat,isfam_shared,isfam_workplane,isfam_vertical,isfam_cuts,maxheight,paraminfo,instance,"Last")
	finalfamilydoc = finalfamilyOP[0]
	finalfamilysavepath = finalfamilyOP[1]
	
	
	# Load Second to Final Family
	loadOP(secondplantdoc,finalfamilydoc,secondplantsavepath,None,paraminfo,"Last",forceworkplane,isceiling,autoheight,safeheight,adaptivemode)
	
	# Load Final Family to Project and Close It Then Delete It from TEMP and Close Initial Family
	if overwriteparameters:
		finalfamily = finalfamilydoc.LoadFamily(projectdoc,FamOpt1())
	else:
		finalfamily = finalfamilydoc.LoadFamily(projectdoc,FamOptWithout())
	finalfamilydoc.Close(False)
	System.IO.File.Delete(finalfamilysavepath)
	
	# Restore Missing Type Mark
	if typemark != None:
		TransactionManager.Instance.ForceCloseTransaction()
		trans1 = Transaction(projectdoc, 'Restoring Type Mark')
		trans1.Start()
		warnhandle = WarnSwallowSimple()
		foptions = trans1.GetFailureHandlingOptions()
		foptions.SetFailuresPreprocessor(warnhandle)
		trans1.SetFailureHandlingOptions(foptions)
		finaltype = finalfamily.GetFamilySymbolIds().GetEnumerator()
		finaltype.MoveNext()
		projectdoc.GetElement(finaltype.Current).get_Parameter(BuiltInParameter.ALL_MODEL_TYPE_MARK).Set(typemark)
		trans1.Commit()
	
	# Result Family
	OUT = finalfamily
# ----------------------------------------
VAROutput = Output(python_script)
