# Dynamo custom node K-Section Dimensions.dyf (Dynamo 2.1.0.7500)
# category: Synthesize.Automate.Dimensions
# K-Section Dimensions

VARPlaceAutoDimensions = Input(VARPlaceAutoDimensions: var[]..[])
VARrealCurves = Input(VARrealCurves: var[]..[])
curves = PolyCurve.Curves(polyCurve=VARrealCurves)
flatten = List.Flatten(list=curves@L2)
empty = List.Empty()
scopeIf = Custom[CW.ScopeIf+](VARtest=VARPlaceAutoDimensions, VARtrue=flatten, VARfalse=empty)  # A (hopefully) more robust implementation of ScopeIf. Tests a single boolean and returns a value accordingly.
VARSectionView = Input(VARSectionView: var[]..[])
matchLength = Custom[LF.List.MatchLength](VARlistLength=curves, VARlist=VARSectionView, lacing=Longest)  # Cycle a list to match the length of the first list.
flatten_2 = List.Flatten(list=matchLength)
scopeIf_2 = Custom[CW.ScopeIf+](VARtest=VARPlaceAutoDimensions, VARtrue=flatten_2, VARfalse=empty)
lines_auto_dimensions = Custom[Lines Auto Dimensions](VARCurves=scopeIf@L2, VARViews=scopeIf_2@L1)  # Lines Auto Dimensions
code_block = CodeBlock { false; }
clean = List.Clean(list=lines_auto_dimensions, preserveIndices=code_block)
flatten_3 = List.Flatten(list=clean)
code_block_2 = CodeBlock { "Type"; }
al_get_all_dimension_types = Custom[AL.Get All Dimension Types]()  # This node will query all of the available dimension styles (this includes linear as well as arc, circle etc).
code_block_3 = CodeBlock { "Type Name"; }
getParameterValueByName = Element.GetParameterValueByName(element=al_get_all_dimension_types, parameterName=code_block_3)
code_block_4 = CodeBlock { ""; }
eq = getParameterValueByName == code_block_4
filterByBoolMask = List.FilterByBoolMask(list=al_get_all_dimension_types, mask=eq)
filterByBoolMask_2 = List.FilterByBoolMask(list=getParameterValueByName, mask=eq)
as_list_sortbykey = Custom[AS.[&] List.SortByKey](VARlist=filterByBoolMask.out, VARkeys=filterByBoolMask_2.out)  # Sort a list (or lists) according to the order specified by the key list.
VARDimensionTypeNumber = Input(VARDimensionTypeNumber: var[]..[])
getItemAtIndex = List.GetItemAtIndex(list=as_list_sortbykey.VARsortedlist, index=VARDimensionTypeNumber)
setParameterByName = Element.SetParameterByName(element=flatten_3, parameterName=code_block_2, value=getItemAtIndex)
getParameterValueByName_2 = Element.GetParameterValueByName(element=as_list_sortbykey.VARsortedlist, parameterName=code_block_3)
VARDimensionTypeNumbers = Output(getParameterValueByName_2)
VARDimension = Output(flatten_3)
code_block_5 = CodeBlock { null; }
replaceEmptyLists = Custom[CW.List.ReplaceEmptyLists](VARseq=lines_auto_dimensions, VARReplacement=code_block_5)  # Replaces all empty lists within a given list with a substitute
code_block_6 = CodeBlock { 2; }
normalizeDepth = List.NormalizeDepth(list=replaceEmptyLists, rank=code_block_6)
isNull = Object.IsNull(obj=normalizeDepth)
matchLength_2 = Custom[LF.List.MatchLength](VARlistLength=scopeIf@L2, VARlist=isNull@L2)
code_block_7 = CodeBlock { 2; }
normalizeDepth_2 = List.NormalizeDepth(list=matchLength_2, rank=code_block_7)
matchLength_3 = Custom[LF.List.MatchLength](VARlistLength=normalizeDepth_2, VARlist=scopeIf_2, lacing=Longest)
filterByBoolMask_3 = List.FilterByBoolMask(list=matchLength_3, mask=normalizeDepth_2)
code_block_8 = CodeBlock { false; }
clean_2 = List.Clean(list=filterByBoolMask_3.in, preserveIndices=code_block_8)
flatten_4 = List.Flatten(list=clean_2)
filterByBoolMask_4 = List.FilterByBoolMask(list=scopeIf, mask=normalizeDepth_2)
code_block_9 = CodeBlock { false; }
clean_3 = List.Clean(list=filterByBoolMask_4.in, preserveIndices=code_block_9)
code_block_10 = CodeBlock { 0.5; }
pointAtParameter = Curve.PointAtParameter(curve=clean_3, param=code_block_10)
flatten_5 = List.Flatten(list=pointAtParameter)
length = Curve.Length(curve=clean_3)
code_block_11 = CodeBlock { "0."; }
code_block_12 = CodeBlock { 1; }
VARNumberofDigitsofTextforDimensioningNo = Input(VARNumberofDigitsofTextforDimensioningNonLinearLines: var[]..[])
withLeadingZeroes = Custom[CW.List.WithLeadingZeroes](VARnum=code_block_12, VARn=VARNumberofDigitsofTextforDimensioningNo)  # Adds leading zeros to a sequence of numbers
code_block_13 = CodeBlock(a=code_block_11, b=withLeadingZeroes) { a+b; }
toNumber = String.ToNumber(str=code_block_13)
roundToPrecision = Custom[CW.Math.RoundToPrecision](VARdbl=length, VARprecision=toNumber)  # Rounds a number to a specified precision
format_numbers = Custom[Format Numbers](VARNumbers=roundToPrecision@L1, VARDecimals=VARNumberofDigitsofTextforDimensioningNo)  # Increase Decimals
VARSuffixofTextforDimensioningNonLinearL = Input(VARSuffixofTextforDimensioningNonLinearLines: var[]..[])
code_block_14 = CodeBlock(a=format_numbers, b=VARSuffixofTextforDimensioningNonLinearL) { a+b; }
flatten_6 = List.Flatten(list=code_block_14)
code_block_15 = CodeBlock { "Middle Align"; }
byLocation = TextNote.ByLocation(view=flatten_4, location=flatten_5, text=flatten_6, alignment=code_block_15)
VARTextNote = Output(byLocation)
VARSectionViews = Output(clean_2)
