# Dynamo custom node K-Section.dyf (Dynamo 2.1.0.7500)
# category: Synthesize.Automate.Surface
# K-Section

VARActivateFarClipping = Input(VARActivateFarClipping: var[]..[])
empty = List.Empty()
VARFlipSection = Input(VARFlipSection: var[]..[])
VARProceed = Input(VARProceed: var[]..[])
VARSurfaces = Input(VARSurfaces: var[]..[])
area = Surface.Area(surface=VARSurfaces)
VARIncludeSurfaceswithAreaGreaterthan = Input(VARIncludeSurfaceswithAreaGreaterthan: var[]..[])
gt = area > VARIncludeSurfaceswithAreaGreaterthan
filterByBoolMask = List.FilterByBoolMask(list=VARSurfaces, mask=gt)
empty_2 = List.Empty()
scopeIf = Custom[CW.ScopeIf+](VARtest=VARProceed, VARtrue=filterByBoolMask.in, VARfalse=empty_2)  # A (hopefully) more robust implementation of ScopeIf. Tests a single boolean and returns a value accordingly.
flatten = List.Flatten(list=scopeIf)
byGeometry = BoundingBox.ByGeometry(geom=flatten, lacing=Longest)
toCuboid = BoundingBox.ToCuboid(boundingBox=byGeometry)
code_block = CodeBlock { 1; }
chop = List.Chop(list=toCuboid, lengths=code_block)
volume = Solid.Volume(lacing=Longest)  # unwired: solid
map = List.Map(list=chop, f_x=volume)
flatten_2 = List.Flatten(list=map)
code_block_2 = CodeBlock { 0; }
eq = flatten_2 == code_block_2
filterByBoolMask_2 = List.FilterByBoolMask(list=flatten, mask=eq)
code_block_3 = CodeBlock { 1; }
thicken = Surface.Thicken(surface=filterByBoolMask_2.in, thickness=code_block_3)
mergeByBoolMask = Custom[SP.List.MergeByBoolMask](VARIn=thicken, VAROut=filterByBoolMask_2.out, VARmask=eq)  # Merge two lists by a boolean mask list. The true count in the mask should be the same as the length of the true list and vice versa for the false list.
isNull = Object.IsNull(obj=flatten_2)
filterByBoolMask_3 = List.FilterByBoolMask(list=mergeByBoolMask, mask=isNull)
code_block_4 = CodeBlock { 1; }
thicken_2 = Surface.Thicken(surface=filterByBoolMask_3.in, thickness=code_block_4)
mergeByBoolMask_2 = Custom[SP.List.MergeByBoolMask](VARIn=thicken_2, VAROut=filterByBoolMask_3.out, VARmask=isNull)
byGeometry_2 = BoundingBox.ByGeometry(geom=mergeByBoolMask_2, lacing=Longest)
toCuboid_2 = BoundingBox.ToCuboid(boundingBox=byGeometry_2)
centroid = Solid.Centroid(solid=toCuboid_2)
XYZ = Custom[LF.Point.XYZ](VARpoint=centroid)  # Get the X, Y, and Z components of a Point
VARSectionLocationFrontOffset = Input(VARSectionLocationFrontOffset: var[]..[])
code_block_5 = CodeBlock { 0; -1; }
gt_2 = VARSectionLocationFrontOffset > code_block_5.out0
mul = VARSectionLocationFrontOffset * code_block_5.out1
scopeIf_2 = Custom[CW.ScopeIf+](VARtest=gt_2, VARtrue=mul, VARfalse=VARSectionLocationFrontOffset)
code_block_6 = CodeBlock { 0; -1; }
lt = VARSectionLocationFrontOffset < code_block_6.out0
mul_2 = VARSectionLocationFrontOffset * code_block_6.out1
scopeIf_3 = Custom[CW.ScopeIf+](VARtest=lt, VARtrue=mul_2, VARfalse=VARSectionLocationFrontOffset)
scopeIf_4 = Custom[CW.ScopeIf+](VARtest=VARFlipSection, VARtrue=scopeIf_2, VARfalse=scopeIf_3)
code_block_7 = CodeBlock { 2; }
div = scopeIf_4 / code_block_7
sub = XYZ.VARZ - div
byCoordinates = Point.ByCoordinates(x=XYZ.VARX, y=XYZ.VARY, z=sub)
byOrigin = CoordinateSystem.ByOrigin(origin=byCoordinates)
code_block_8 = CodeBlock { 0.5; }
pointAtParameter = Surface.PointAtParameter(surface=flatten, u=code_block_8, v=code_block_8)
normalAtPoint = Surface.NormalAtPoint(surface=flatten, point=pointAtParameter)
byOriginNormal = Plane.ByOriginNormal(origin=pointAtParameter, normal=normalAtPoint)
byPlane = CoordinateSystem.ByPlane(plane=byOriginNormal)
transform = CoordinateSystem.Transform(coordinateSystem=byOrigin, fromCoordinateSystem=byOrigin, contextCoordinateSystem=byPlane)
ZAxis = CoordinateSystem.ZAxis(coordinateSystem=transform)
translate = CoordinateSystem.Translate(coordinateSystem=transform, direction=ZAxis, distance=div)
join = List.Join()  # unwired: list0, list1
length = Cuboid.Length(cuboid=toCuboid_2)
width = Cuboid.Width(cuboid=toCuboid_2)
combine = List.Combine(comb=join, list1=length, list2=width)
maximumItem = List.MaximumItem(list=combine)
eq_2 = maximumItem == combine
filterByBoolMask_4 = List.FilterByBoolMask(list=combine, mask=eq_2)
firstItem = List.FirstItem(list=filterByBoolMask_4.in@L2)
byLengths = Cuboid.ByLengths(cs=translate, width=firstItem, length=firstItem, height=scopeIf_4)
explode = Geometry.Explode(geometry=byLengths)
perimeterCurves = Surface.PerimeterCurves(surface=explode)
startPoint = Curve.StartPoint(curve=perimeterCurves)
flatten_3 = List.Flatten(list=startPoint@L3)
pruneDuplicates = Point.PruneDuplicates(points=flatten_3)
code_block_9 = CodeBlock { 4; -4; }
scopeIf_5 = Custom[CW.ScopeIf+](VARtest=VARFlipSection, VARtrue=code_block_9.out1, VARfalse=code_block_9.out0)
takeItems = List.TakeItems(list=pruneDuplicates@L2, amount=scopeIf_5)
reverse = List.Reverse(list=takeItems@L2)
scopeIf_6 = Custom[CW.ScopeIf+](VARtest=VARFlipSection, VARtrue=reverse, VARfalse=takeItems)
byPerimeterPoints = Surface.ByPerimeterPoints(points=scopeIf_6)
VARFarClipOffset = Input(VARFarClipOffset: var[]..[])
section_by_surface = Custom[Section By Surface](VARSurface=byPerimeterPoints@L1, VARFlipSection=VARFlipSection, VARViewDepth=VARFarClipOffset)  # TEMP
flatten_4 = List.Flatten(list=section_by_surface.VARCS)
flatten_5 = List.Flatten(list=section_by_surface.VARMIN)
flatten_6 = List.Flatten(list=section_by_surface.VARMAX)
byCoordinateSystemMinPointMaxPoint = SectionView.ByCoordinateSystemMinPointMaxPoint(cs=flatten_4, minPoint=flatten_5, maxPoint=flatten_6)
scopeIf_7 = Custom[CW.ScopeIf+](VARtest=VARActivateFarClipping, VARtrue=empty, VARfalse=byCoordinateSystemMinPointMaxPoint)
code_block_10 = CodeBlock { "Far Clipping"; 0; }
setParameterByName = Element.SetParameterByName(element=scopeIf_7, parameterName=code_block_10.out0, value=code_block_10.out1)
code_block_11 = CodeBlock { "View Name"; }
VARPrefixtoAdd = Input(VARPrefixtoAdd: var[]..[])
VARPanelsMarkName = Input(VARPanelsMarkName: var[]..[])
code_block_12 = CodeBlock(a=VARPrefixtoAdd, b=VARPanelsMarkName) { a+b; }
VARSuffixtoAdd = Input(VARSuffixtoAdd: var[]..[])
code_block_13 = CodeBlock(a=code_block_12, b=VARSuffixtoAdd) { a+b; }
VARSubfaceName = Input(VARSubfaceName: var[]..[])
VARSubfaceSequenceStart = Input(VARSubfaceSequenceStart: var[]..[])
count = List.Count(list=scopeIf@L2)
code_block_14 = CodeBlock { 1; }
sequence = Sequence(start=VARSubfaceSequenceStart, amount=count, step=code_block_14, lacing=Longest)
string_from_object = FromObject(obj=sequence)
code_block_15 = CodeBlock(a=VARSubfaceName, b=string_from_object) { a+b; }
code_block_16 = CodeBlock(a=code_block_13, b=code_block_15) { a+b; }
flatten_7 = List.Flatten(list=code_block_16)
setParameterByName_2 = Element.SetParameterByName(element=byCoordinateSystemMinPointMaxPoint, parameterName=code_block_11, value=flatten_7)
VARSectionView = Output(byCoordinateSystemMinPointMaxPoint)
VARLocations = Output(pointAtParameter)
flatten_8 = List.Flatten(list=filterByBoolMask.in)
VARFaces = Output(flatten_8)
YAxis = CoordinateSystem.YAxis(coordinateSystem=byPlane)
VARreferenceDirection = Output(YAxis)
VARSurface = Output(flatten)
VARPlanes = Output(byOriginNormal)
VARNames = Output(flatten_7)
