# Dynamo custom node K-Super Boders Paneling.dyf (Dynamo 2.1.0.7500)
# category: Synthesize.Automate.Adaptive
# K-Super Map Revit Paneling - Custom

VARTargetSurfaces = Input(VARTargetSurfaces: var[]..[])
code_block = CodeBlock { true; }
VARProceed = Input(VARProceed: var[]..[])
ne = code_block != VARProceed
VARTollerance = Input(VARTollerance: double = 0.2)
VARBorderDetectionTollerance = Input(VARBorderDetectionTollerance: double = 1)
borders_panels = Custom[Borders Panels](VARTargetSurfaces=VARTargetSurfaces, VARShowPolygons=ne, VARTollerance=VARTollerance, VARBorderDetectionTollerance=VARBorderDetectionTollerance)  # Map Revit Panels
flatten = List.Flatten(list=borders_panels.VARReport)
uniqueItems = List.UniqueItems(list=flatten)
VARReport = Output(uniqueItems)
VARSecondaryType = Input(VARSecondaryType: var[]..[])
VARRotationDegree = Input(VARRotationDegree: var[]..[])
VARAdaptivePointsOffset = Input(VARAdaptivePointsOffset: var[]..[])
VARFlip = Input(VARFlip: var[]..[])
code_block_2 = CodeBlock { false; }
k_super_quad_paneling = Custom[K-Super Quad Paneling](VARFamilyType=VARSecondaryType, VARProceed=VARProceed, VARRotationDegree=VARRotationDegree, VARAdaptivePointsOffset=VARAdaptivePointsOffset, VARPointsLists=borders_panels.VARSecondary, VARSurfaces=borders_panels.VARSurfaces, VARFlip=VARFlip, VARFalsePatternTrueAdaptive=code_block_2)  # K-Super Adaptive Paneling
code_block_3 = CodeBlock { false; }
clean = List.Clean(list=k_super_quad_paneling.VARAcceptedCoordinateSystems, preserveIndices=code_block_3)
count = List.Count(list=clean@L3)
code_block_4 = CodeBlock { 1; }
gt = count > code_block_4
code_block_5 = CodeBlock { "No Accepted Panels/Adaptive Components"; }
scopeIf = Custom[CW.ScopeIf+](VARtest=gt, VARtrue=count, VARfalse=code_block_5)  # A (hopefully) more robust implementation of ScopeIf. Tests a single boolean and returns a value accordingly.
VARAcceptedSecondaryPanels = Output(scopeIf)
clean_2 = List.Clean(list=k_super_quad_paneling.VARRejectedCoordinateSystems, preserveIndices=code_block_3)
count_2 = List.Count(list=clean_2@L3)
gt_2 = count_2 > code_block_4
code_block_6 = CodeBlock { "No Rejected Panels/Adaptive Components"; }
scopeIf_2 = Custom[CW.ScopeIf+](VARtest=gt_2, VARtrue=count_2, VARfalse=code_block_6)
VARRejectedSecondaryPanels = Output(scopeIf_2)
VARQuaternaryType = Input(VARQuaternaryType: var[]..[])
code_block_7 = CodeBlock { false; }
k_super_quad_paneling_2 = Custom[K-Super Quad Paneling](VARFamilyType=VARQuaternaryType, VARProceed=VARProceed, VARRotationDegree=VARRotationDegree, VARAdaptivePointsOffset=VARAdaptivePointsOffset, VARPointsLists=borders_panels.VARQuaternary, VARSurfaces=borders_panels.VARSurfaces, VARFlip=VARFlip, VARFalsePatternTrueAdaptive=code_block_7)
code_block_8 = CodeBlock { false; }
clean_3 = List.Clean(list=k_super_quad_paneling_2.VARAcceptedCoordinateSystems, preserveIndices=code_block_8)
count_3 = List.Count(list=clean_3@L3)
code_block_9 = CodeBlock { 1; }
gt_3 = count_3 > code_block_9
code_block_10 = CodeBlock { "No Accepted Panels/Adaptive Components"; }
scopeIf_3 = Custom[CW.ScopeIf+](VARtest=gt_3, VARtrue=count_3, VARfalse=code_block_10)
VARAcceptedQuaternaryPanels = Output(scopeIf_3)
clean_4 = List.Clean(list=k_super_quad_paneling_2.VARRejectedCoordinateSystems, preserveIndices=code_block_8)
count_4 = List.Count(list=clean_4@L3)
gt_4 = count_4 > code_block_9
code_block_11 = CodeBlock { "No Rejected Panels/Adaptive Components"; }
scopeIf_4 = Custom[CW.ScopeIf+](VARtest=gt_4, VARtrue=count_4, VARfalse=code_block_11)
VARRejectedQuaternaryPanels = Output(scopeIf_4)
VARPrimaryType = Input(VARPrimaryType: var[]..[])
code_block_12 = CodeBlock { false; }
k_super_quad_paneling_3 = Custom[K-Super Quad Paneling](VARFamilyType=VARPrimaryType, VARProceed=VARProceed, VARRotationDegree=VARRotationDegree, VARAdaptivePointsOffset=VARAdaptivePointsOffset, VARPointsLists=borders_panels.VARPrimary, VARSurfaces=borders_panels.VARSurfaces, VARFlip=VARFlip, VARFalsePatternTrueAdaptive=code_block_12)
code_block_13 = CodeBlock { false; }
clean_5 = List.Clean(list=k_super_quad_paneling_3.VARAcceptedCoordinateSystems, preserveIndices=code_block_13)
count_5 = List.Count(list=clean_5@L3)
code_block_14 = CodeBlock { 1; }
gt_5 = count_5 > code_block_14
code_block_15 = CodeBlock { "No Accepted Panels/Adaptive Components"; }
scopeIf_5 = Custom[CW.ScopeIf+](VARtest=gt_5, VARtrue=count_5, VARfalse=code_block_15)
VARAcceptedPrimaryPanels = Output(scopeIf_5)
clean_6 = List.Clean(list=k_super_quad_paneling_3.VARRejectedCoordinateSystems, preserveIndices=code_block_13)
count_6 = List.Count(list=clean_6@L3)
gt_6 = count_6 > code_block_14
code_block_16 = CodeBlock { "No Rejected Panels/Adaptive Components"; }
scopeIf_6 = Custom[CW.ScopeIf+](VARtest=gt_6, VARtrue=count_6, VARfalse=code_block_16)
VARRejectedPrimaryPanels = Output(scopeIf_6)
VARQuinaryType = Input(VARQuinaryType: var[]..[])
code_block_17 = CodeBlock { false; }
k_super_quad_paneling_4 = Custom[K-Super Quad Paneling](VARFamilyType=VARQuinaryType, VARProceed=VARProceed, VARRotationDegree=VARRotationDegree, VARAdaptivePointsOffset=VARAdaptivePointsOffset, VARPointsLists=borders_panels.VARQuinary, VARSurfaces=borders_panels.VARSurfaces, VARFlip=VARFlip, VARFalsePatternTrueAdaptive=code_block_17)
code_block_18 = CodeBlock { false; }
clean_7 = List.Clean(list=k_super_quad_paneling_4.VARAcceptedCoordinateSystems, preserveIndices=code_block_18)
count_7 = List.Count(list=clean_7@L3)
code_block_19 = CodeBlock { 1; }
gt_7 = count_7 > code_block_19
code_block_20 = CodeBlock { "No Accepted Panels/Adaptive Components"; }
scopeIf_7 = Custom[CW.ScopeIf+](VARtest=gt_7, VARtrue=count_7, VARfalse=code_block_20)
VARAcceptedQuinaryPanels = Output(scopeIf_7)
clean_8 = List.Clean(list=k_super_quad_paneling_4.VARRejectedCoordinateSystems, preserveIndices=code_block_18)
count_8 = List.Count(list=clean_8@L3)
gt_8 = count_8 > code_block_19
code_block_21 = CodeBlock { "No Rejected Panels/Adaptive Components"; }
scopeIf_8 = Custom[CW.ScopeIf+](VARtest=gt_8, VARtrue=count_8, VARfalse=code_block_21)
VARRejectedQuinaryPanels = Output(scopeIf_8)
VARTertiaryType = Input(VARTertiaryType: var[]..[])
code_block_22 = CodeBlock { false; }
k_super_quad_paneling_5 = Custom[K-Super Quad Paneling](VARFamilyType=VARTertiaryType, VARProceed=VARProceed, VARRotationDegree=VARRotationDegree, VARAdaptivePointsOffset=VARAdaptivePointsOffset, VARPointsLists=borders_panels.VARTertiary, VARSurfaces=borders_panels.VARSurfaces, VARFlip=VARFlip, VARFalsePatternTrueAdaptive=code_block_22)
code_block_23 = CodeBlock { false; }
clean_9 = List.Clean(list=k_super_quad_paneling_5.VARAcceptedCoordinateSystems, preserveIndices=code_block_23)
count_9 = List.Count(list=clean_9@L3)
code_block_24 = CodeBlock { 1; }
gt_9 = count_9 > code_block_24
code_block_25 = CodeBlock { "No Accepted Panels/Adaptive Components"; }
scopeIf_9 = Custom[CW.ScopeIf+](VARtest=gt_9, VARtrue=count_9, VARfalse=code_block_25)
VARAcceptedTertiaryPanels = Output(scopeIf_9)
clean_10 = List.Clean(list=k_super_quad_paneling_5.VARRejectedCoordinateSystems, preserveIndices=code_block_23)
count_10 = List.Count(list=clean_10@L3)
gt_10 = count_10 > code_block_24
code_block_26 = CodeBlock { "No Rejected Panels/Adaptive Components"; }
scopeIf_10 = Custom[CW.ScopeIf+](VARtest=gt_10, VARtrue=count_10, VARfalse=code_block_26)
VARRejectedTertiaryPanels = Output(scopeIf_10)
code_block_27 = CodeBlock { false; }
clean_11 = List.Clean(list=borders_panels.VARPolygons, preserveIndices=code_block_27)
flatten_2 = List.Flatten(list=clean_11)
byPatch = Surface.ByPatch(closedCurve=flatten_2)
code_block_28 = CodeBlock { false; }
clean_12 = List.Clean(list=byPatch, preserveIndices=code_block_28)
code_block_29 = CodeBlock { true; }
dynamo_geometry_to_revit = Custom[Dynamo Geometry To Revit Compatibility](VARGeometryOrSat=clean_12, VARPreferImportInstance=code_block_29, VARPreferOneElement=code_block_29)  # Dynamo Geometry To Revit Compatibility
create = List.Create(item0=k_super_quad_paneling_3.VARAdaptiveComponent, item1=k_super_quad_paneling.VARAdaptiveComponent, item2=k_super_quad_paneling_5.VARAdaptiveComponent, item3=k_super_quad_paneling_2.VARAdaptiveComponent, item4=k_super_quad_paneling_4.VARAdaptiveComponent, item5=dynamo_geometry_to_revit)
code_block_30 = CodeBlock { false; }
clean_13 = List.Clean(list=create, preserveIndices=code_block_30)
flatten_3 = List.Flatten(list=clean_13)
VAROutput = Output(flatten_3)
