# Dynamo custom node K-Super Geodesic Master Paneling.dyf (Dynamo 2.1.0.7500)
# category: Synthesize.Automate.Adaptive
# K-Supe Geodesic Master Paneling

VARFamilyType = Input(VARFamilyType: var[]..[])
VARProceed = Input(VARProceed: var[]..[])
VARRotationDegree = Input(VARRotationDegree: var[]..[])
VARAdaptivePointsOffset = Input(VARAdaptivePointsOffset: var[]..[])
VARDomeMethodUpperDome1DownerDome2FullSp = Input(VARDomeMethodUpperDome1DownerDome2FullSphere3: var[]..[])
python_script = Python(IN[0]=VARDomeMethodUpperDome1DownerDome2FullSp)
# ---------- python_script.python (14 lines) ----------
import clr
clr.AddReference('ProtoGeometry')
from Autodesk.DesignScript.Geometry import *
#The inputs to this node will be stored as a list in the IN variables.
dataEnteringNode = IN

method = IN[0]

result = False

if method == 1 or method == 2:
	result = True
#Assign your output to the OUT variable.
OUT = result
# ----------------------------------------
VARIntensity = Input(VARIntensity: var[]..[])
VARDomeFace = Input(VARDomeFace: var[]..[])
boundingBox = Geometry.BoundingBox(geometry=VARDomeFace)
toCuboid = BoundingBox.ToCuboid(boundingBox=boundingBox)
height = Cuboid.Height(cuboid=toCuboid)
code_block = CodeBlock { 3; }
round = Math.Round(number=height, digits=code_block)
firstItem = List.FirstItem(list=round)

# group: Thanks to Vikram
code_block_2 = CodeBlock(d=VARIntensity, rad=firstItem)
# ---------- code_block_2.designscript (54 lines) ----------
//Icosahedron
p=(1+Math.Sqrt(5))/2;
a=Point.ByCoordinates([0,0,0,0,p,-p,-p,p,1,-1,-1,1],[1,-1,-1,1,0,0,0,0,p,p,-p,-p],[p,p,-p,-p,1,1,-1,-1,0,0,0,0]);
b=[[a[0],a[8],a[9]],[a[0],a[9],a[5]],[a[0],a[5],a[1]],[a[0],a[1],a[4]],[a[0],a[4],a[8]],
[a[1],a[5],a[10]],[a[1],a[10],a[11]],[a[1],a[11],a[4]],[a[2],a[3],a[7]],[a[2],a[7],a[11]],
[a[2],a[11],a[10]],[a[2],a[10],a[6]],[a[2],a[6],a[3]],[a[3],a[6],a[9]],[a[3],a[9],a[8]],
[a[3],a[8],a[7]],[a[4],a[11],a[7]],[a[4],a[7],a[8]],[a[5],a[9],a[6]],[a[5],a[6],a[10]]];
tri=Surface.ByPerimeterPoints(b);

//Sub dividing equilateral faces
 //Edges of equilateral surface
crv1=tri.PerimeterCurves();
len1=List.GetItemAtIndex(crv1<1>,0).Length;
n=d<1?1:d;
len2=len1/n;

//Vertices of equilateral surface
pnt1=List.GetItemAtIndex(crv1<1>,0).StartPoint;
pnt2=List.GetItemAtIndex(crv1<1>,1).StartPoint;
pnt3=List.GetItemAtIndex(crv1<1>,2).StartPoint;

dir1=Vector.ByTwoPoints(pnt1,pnt2);
dir2=Vector.ByTwoPoints(pnt1,pnt3);
dir3=Vector.ByTwoPoints(pnt2,pnt3);

//Sub triangle 1
pnt4=pnt1.Translate(dir1,len2);
pnt5=pnt1.Translate(dir2,len2);
sub1=Polygon.ByPoints(Transpose([pnt1,pnt4,pnt5]));

//Repeating sub triangle
n2=(0..(n-1))*len2<1>;
sub2=sub1.Translate(dir1,n2);
n3=List.TakeItems(n2<1>,1..n);
sub3=sub2.Translate(dir3,n3);

//Sub triangle 2
pnt6=n<2?pnt1:pnt4.Translate(dir2,len2);
sub4=Polygon.ByPoints(Transpose([pnt4,pnt5,pnt6]));
n4=(0..(n-2))*len2<1>;
sub5=sub4.Translate(dir1,n4);
n5=List.TakeItems(n4<1>,1..n);
sub6=sub5.Translate(dir3,n5);

srf1=sub3.Patch();
srf2=sub6.Patch();
srf11=Flatten(List.TakeItems([srf1,srf2],n));
sub21=Flatten(List.TakeItems([sub3,sub6],n));

plPnt1=Flatten(sub21).Points;
plDir1=Vector.ByTwoPoints(Point.Origin(),plPnt1);

sph=Sphere.ByCenterPointRadius(Point.Origin(),rad);
plPnt21=(sph.ProjectInputOnto(plPnt1,plDir1)<1>);
# ----------------------------------------

flatten = List.Flatten(list=code_block_2.plPnt21@@L3)
byPoints = Polygon.ByPoints(points=flatten)
byPatch = Surface.ByPatch(closedCurve=byPoints)
empty = List.Empty()
scopeIf = Custom[CW.ScopeIf+](VARtest=python_script, VARtrue=byPatch, VARfalse=empty)  # A (hopefully) more robust implementation of ScopeIf. Tests a single boolean and returns a value accordingly.
byOriginNormal = Plane.ByOriginNormal()
split = Geometry.Split(geometry=scopeIf, other=byOriginNormal)
flatten_2 = List.Flatten(list=split)
code_block_3 = CodeBlock { 0.5; }
pointAtParameter = Surface.PointAtParameter(surface=flatten_2, u=code_block_3, v=code_block_3)
Z = Point.Z(point=pointAtParameter)
code_block_4 = CodeBlock { 0; }
gt = Z > code_block_4
lt = Z < code_block_4
python_script_2 = Python(IN[0]=VARDomeMethodUpperDome1DownerDome2FullSp, IN[1]=gt, IN[2]=lt)
# ---------- python_script_2.python (16 lines) ----------
import clr
clr.AddReference('ProtoGeometry')
from Autodesk.DesignScript.Geometry import *
#The inputs to this node will be stored as a list in the IN variables.
dataEnteringNode = IN

method = IN[0]
one = IN[1]
two = IN[2]

if method == 1:
	result = one
else:
	result = two
#Assign your output to the OUT variable.
OUT = result
# ----------------------------------------
filterByBoolMask = List.FilterByBoolMask(list=flatten_2, mask=python_script_2)
flatten_3 = List.Flatten(list=filterByBoolMask.in)
scopeIf_2 = Custom[CW.ScopeIf+](VARtest=python_script, VARtrue=flatten_3, VARfalse=byPatch)
perimeterCurves = Surface.PerimeterCurves(surface=scopeIf_2)
startPoint = Curve.StartPoint(curve=perimeterCurves)
VARXScale = Input(VARXScale: var[]..[])
VARYScale = Input(VARYScale: var[]..[])
VARZScale = Input(VARZScale: var[]..[])
scale = Geometry.Scale(geometry=startPoint, plane=byOriginNormal, xamount=VARXScale, yamount=VARYScale, zamount=VARZScale)
offset = Surface.Offset(surface=scopeIf_2, distance=firstItem)
code_block_5 = CodeBlock { 0.5; }
pointAtParameter_2 = Surface.PointAtParameter(surface=offset, u=code_block_5, v=code_block_5)
doesIntersect = Geometry.DoesIntersect(geometry=code_block_2.sph, other=pointAtParameter_2)
filterByBoolMask_2 = List.FilterByBoolMask(list=scale, mask=doesIntersect)
reverse = List.Reverse(list=filterByBoolMask_2.in@L2)
mergeByBoolMask = Custom[SP.List.MergeByBoolMask](VARIn=reverse, VAROut=filterByBoolMask_2.out, VARmask=doesIntersect)  # Merge two lists by a boolean mask list. The true count in the mask should be the same as the length of the true list and vice versa for the false list.
byGeometry = BoundingBox.ByGeometry(geom=byPatch)
centerPoint = Custom[ZK.BoundingBox.CenterPoint](VARBoundingBox=byGeometry)  # Input Bounding Box element to get its center point. This node is little and lightweight, as it doesn't convert bounding box to geometry to get its centroid point.
byOrigin = CoordinateSystem.ByOrigin(origin=centerPoint)
perimeterCurves_2 = Surface.PerimeterCurves(surface=VARDomeFace)
curves_offset_to_revit = Custom[Curves Offset To Revit Compatibility](VARCurves=perimeterCurves_2)  # Curves Offset To Revit Compatibility
centerPoint_2 = Arc.CenterPoint(arc=curves_offset_to_revit.VARCurves)
flatten_4 = List.Flatten(list=centerPoint_2)
firstItem_2 = List.FirstItem(list=flatten_4)
byOrigin_2 = CoordinateSystem.ByOrigin(origin=firstItem_2)
ZAxis = Vector.ZAxis()
VARRotationDegrees = Input(VARRotationDegrees: double)
rotate = CoordinateSystem.Rotate(coordinateSystem=byOrigin_2, origin=firstItem_2, axis=ZAxis, degrees=VARRotationDegrees)
transform = Geometry.Transform(geometry=mergeByBoolMask, fromCoordinateSystem=byOrigin, contextCoordinateSystem=rotate)
create = List.Create(item0=transform)
flatten_5 = List.Flatten(list=code_block_2.sph)
explode = Geometry.Explode(geometry=flatten_5)
code_block_6 = CodeBlock(a=explode) { a[0]; }
scale_2 = Geometry.Scale(geometry=code_block_6, plane=byOriginNormal, xamount=VARXScale, yamount=VARYScale, zamount=VARZScale)
transform_2 = Geometry.Transform(geometry=scale_2, fromCoordinateSystem=byOrigin, contextCoordinateSystem=rotate)
VARFlip = Input(VARFlip: var[]..[])
code_block_7 = CodeBlock { false; }
k_super_quad_paneling = Custom[K-Super Quad Paneling](VARFamilyType=VARFamilyType, VARProceed=VARProceed, VARRotationDegree=VARRotationDegree, VARAdaptivePointsOffset=VARAdaptivePointsOffset, VARPointsLists=create, VARSurfaces=transform_2, VARFlip=VARFlip, VARFalsePatternTrueAdaptive=code_block_7)  # K-Super Adaptive Paneling
code_block_8 = CodeBlock { false; }
clean = List.Clean(list=k_super_quad_paneling.VARAcceptedCoordinateSystems, preserveIndices=code_block_8)
count = List.Count(list=clean@L3)
code_block_9 = CodeBlock { 1; }
gt_2 = count > code_block_9
code_block_10 = CodeBlock { "No Accepted Panels/Adaptive Components"; }
scopeIf_3 = Custom[CW.ScopeIf+](VARtest=gt_2, VARtrue=count, VARfalse=code_block_10)
VARAcceptedPanels = Output(scopeIf_3)
clean_2 = List.Clean(list=k_super_quad_paneling.VARRejectedCoordinateSystems, preserveIndices=code_block_8)
count_2 = List.Count(list=clean_2@L3)
gt_3 = count_2 > code_block_9
code_block_11 = CodeBlock { "No Rejected Panels/Adaptive Components"; }
scopeIf_4 = Custom[CW.ScopeIf+](VARtest=gt_3, VARtrue=count_2, VARfalse=code_block_11)
VARRejectedPanels = Output(scopeIf_4)
empty_2 = List.Empty()
scopeIf_5 = Custom[CW.ScopeIf+](VARtest=VARProceed, VARtrue=empty_2, VARfalse=scale)
byPoints_2 = Polygon.ByPoints(points=scopeIf_5)
byPatch_2 = Surface.ByPatch(closedCurve=byPoints_2)
flatten_6 = List.Flatten(list=byPatch_2)
create_2 = List.Create(item0=flatten_6)
transform_3 = Geometry.Transform(geometry=create_2, fromCoordinateSystem=byOrigin, contextCoordinateSystem=rotate)
create_3 = List.Create(item0=transform_3)
code_block_12 = CodeBlock { true; }
dynamo_geometry_to_revit = Custom[Dynamo Geometry To Revit Compatibility](VARGeometryOrSat=create_3, VARPreferImportInstance=code_block_12, VARPreferOneElement=code_block_12)  # Dynamo Geometry To Revit Compatibility
create_4 = List.Create(item0=k_super_quad_paneling.VARAdaptiveComponent, item1=dynamo_geometry_to_revit)
code_block_13 = CodeBlock { false; }
clean_3 = List.Clean(list=create_4, preserveIndices=code_block_13)
flatten_7 = List.Flatten(list=clean_3)
VAROutput = Output(flatten_7)
