# Dynamo custom node K-Super Triangle Diagonal Paneling.dyf (Dynamo 2.1.0.7500)
# category: Synthesize.Automate.Adaptive
# K-Super Triangle Diagonal Paneling

VARAType = Input(VARAType: var[]..[])
VARProceed = Input(VARProceed: var[]..[])
VARRotationDegree = Input(VARRotationDegree: var[]..[])
VARAdaptivePointsOffset = Input(VARAdaptivePointsOffset: var[]..[])
VARSATFile = Input(VARSATFile: var[]..[])
fileExists = FileSystem.FileExists(path=VARSATFile)
python_script = Python(IN[0]=VARSATFile)
# ---------- python_script.python (40 lines) ----------
# Enable Python support and load DesignScript library
# IMPORTANT : ALL DYNAMO DESIGN SCRIPT NODES ARE AS (dg)
import clr
clr.AddReference('ProtoGeometry')
from Autodesk.DesignScript import Geometry as dg

# EXTENSION Enable ToDSType
clr.AddReference('RevitNodes')
import Revit
clr.ImportExtensions(Revit.Elements)

# Enable Revit Elements
from Revit.Elements import *

# EXTENSION Enable Geometry Conversion Methods
clr.ImportExtensions(Revit.GeometryConversion)

# Enable Revit API
clr.AddReference('RevitAPI')
from Autodesk.Revit.DB import *

# Enable DocumentManager and TransactionManager
clr.AddReference('RevitServices')
from RevitServices.Persistence import DocumentManager
from RevitServices.Transactions import TransactionManager

# Enable ICollection List Translate
clr.AddReference("System")
import System.Collections.Generic
from System.Collections.Generic import List

dataEnteringNode = IN
# Use UnwrapElement(IN[0]) When Translating From Dynamo to Revit
file=UnwrapElement(IN[0])
try:
	result = dg.Geometry.ImportFromSAT(file)
except:
	result = []
# Assign your output to the OUT variable.
OUT = result
# ----------------------------------------
explode = Geometry.Explode(geometry=python_script)
code_block = CodeBlock { "Surface"; }
byClassName = Custom[SP.Filter.ByClassName](VARobject=explode, VARclassName=code_block)  # Filters a list of objects by the object's class name. Note that Dynamo elements belong to different classes than their Revit counterparts. Use the Object.Class node to check an object's class.
toNurbsSurface = Surface.ToNurbsSurface(surface=byClassName.VARin)
perimeter = Surface.Perimeter(surface=toNurbsSurface)
code_block_2 = CodeBlock { 3; }
round = Math.Round(number=perimeter, digits=code_block_2)
perimeter_2 = Surface.Perimeter(surface=byClassName.VARin)
round_2 = Math.Round(number=perimeter_2, digits=code_block_2)
eq = round == round_2
filterByBoolMask = List.FilterByBoolMask(list=toNurbsSurface, mask=eq)
VARSurfaces = Input(VARSurfaces: var[]..[])
surface_importer = Custom[Surface Importer](VARSurfaces=VARSurfaces)  # Surface Importer Node
surfaces = PolySurface.Surfaces(polySurface=surface_importer)
scopeIf = Custom[CW.ScopeIf+](VARtest=fileExists, VARtrue=filterByBoolMask.in, VARfalse=surfaces)  # A (hopefully) more robust implementation of ScopeIf. Tests a single boolean and returns a value accordingly.
flatten = List.Flatten(list=scopeIf)
VARU = Input(VARU: int)
VARV = Input(VARV: int)
code_block_3 = CodeBlock(unum=VARU, vnum=VARV) { uvlist = UV.ByCoordinates((0..1..#unum+1)<1>,(0..1..#vnum+1)<2>); }
flatten_2 = List.Flatten(list=code_block_3)
VARreverseTypeA = Input(VARreverseTypeA: bool)
VARreverseTypeB = Input(VARreverseTypeB: bool)
VARshiftPlacementTypeA = Input(VARshiftPlacementTypeA: int)
VARshiftPlacementTypeB = Input(VARshiftPlacementTypeB: int)
VARshiftOverallPlacement = Input(VARshiftOverallPlacement: int)
VARrotateGridBy90Degrees = Input(VARrotateGridBy90Degrees: bool)
triangularFlatDiagonal = Custom[CW.Paneling.TriangularFlatDiagonal](VARseq=flatten_2, VARV=VARV, VARreverseTypeA=VARreverseTypeA, VARreverseTypeB=VARreverseTypeB, VARshiftPlacementTypeA=VARshiftPlacementTypeA, VARshiftPlacementTypeB=VARshiftPlacementTypeB, VARshiftOverallPlacement=VARshiftOverallPlacement, VARrotateGridBy90Degrees=VARrotateGridBy90Degrees)  # Creates groups of points from a list of UVs or XYZs for the placement of triangular panels. The placement pattern can be reversed (boolean) and shifted (integer).
U = UV.U(uV=triangularFlatDiagonal.VARtypeA)
V = UV.V(uV=triangularFlatDiagonal.VARtypeA)
pointAtParameter = Surface.PointAtParameter(surface=flatten@L1, u=U, v=V)
VARFlip = Input(VARFlip: var[]..[])
code_block_4 = CodeBlock { false; }
k_super_quad_paneling = Custom[K-Super Quad Paneling](VARFamilyType=VARAType, VARProceed=VARProceed, VARRotationDegree=VARRotationDegree, VARAdaptivePointsOffset=VARAdaptivePointsOffset, VARPointsLists=pointAtParameter, VARSurfaces=flatten, VARFlip=VARFlip, VARFalsePatternTrueAdaptive=code_block_4)  # K-Super Adaptive Paneling
code_block_5 = CodeBlock { false; }
clean = List.Clean(list=k_super_quad_paneling.VARAcceptedCoordinateSystems, preserveIndices=code_block_5)
count = List.Count(list=clean@L3)
code_block_6 = CodeBlock { 1; }
gt = count > code_block_6
code_block_7 = CodeBlock { "No Accepted Panels/Adaptive Components"; }
scopeIf_2 = Custom[CW.ScopeIf+](VARtest=gt, VARtrue=count, VARfalse=code_block_7)
VARAcceptedATriangular = Output(scopeIf_2)
clean_2 = List.Clean(list=k_super_quad_paneling.VARRejectedCoordinateSystems, preserveIndices=code_block_5)
count_2 = List.Count(list=clean_2@L3)
gt_2 = count_2 > code_block_6
code_block_8 = CodeBlock { "No Rejected Panels/Adaptive Components"; }
scopeIf_3 = Custom[CW.ScopeIf+](VARtest=gt_2, VARtrue=count_2, VARfalse=code_block_8)
VARRejectedATriangular = Output(scopeIf_3)
VARBType = Input(VARBType: var[]..[])
U_2 = UV.U(uV=triangularFlatDiagonal.VARtypeB)
V_2 = UV.V(uV=triangularFlatDiagonal.VARtypeB)
pointAtParameter_2 = Surface.PointAtParameter(surface=flatten@L1, u=U_2, v=V_2)
code_block_9 = CodeBlock { false; }
k_super_quad_paneling_2 = Custom[K-Super Quad Paneling](VARFamilyType=VARBType, VARProceed=VARProceed, VARRotationDegree=VARRotationDegree, VARAdaptivePointsOffset=VARAdaptivePointsOffset, VARPointsLists=pointAtParameter_2, VARSurfaces=flatten, VARFlip=VARFlip, VARFalsePatternTrueAdaptive=code_block_9)
code_block_10 = CodeBlock { false; }
clean_3 = List.Clean(list=k_super_quad_paneling_2.VARAcceptedCoordinateSystems, preserveIndices=code_block_10)
count_3 = List.Count(list=clean_3@L3)
code_block_11 = CodeBlock { 1; }
gt_3 = count_3 > code_block_11
code_block_12 = CodeBlock { "No Accepted Panels/Adaptive Components"; }
scopeIf_4 = Custom[CW.ScopeIf+](VARtest=gt_3, VARtrue=count_3, VARfalse=code_block_12)
VARAcceptedBTriangular = Output(scopeIf_4)
clean_4 = List.Clean(list=k_super_quad_paneling_2.VARRejectedCoordinateSystems, preserveIndices=code_block_10)
count_4 = List.Count(list=clean_4@L3)
gt_4 = count_4 > code_block_11
code_block_13 = CodeBlock { "No Rejected Panels/Adaptive Components"; }
scopeIf_5 = Custom[CW.ScopeIf+](VARtest=gt_4, VARtrue=count_4, VARfalse=code_block_13)
VARRejectedBTriangular = Output(scopeIf_5)
code_block_14 = CodeBlock { true; }
ne = VARProceed != code_block_14
empty = List.Empty()
scopeIf_6 = Custom[CW.ScopeIf+](VARtest=ne, VARtrue=pointAtParameter, VARfalse=empty)
polygon_bypoints_fixer = Custom[Polygon.ByPoints Fixer](VARpoints=scopeIf_6)  # Polygon.ByPoints Fixer
empty_2 = List.Empty()
scopeIf_7 = Custom[CW.ScopeIf+](VARtest=ne, VARtrue=pointAtParameter_2, VARfalse=empty_2)
polygon_bypoints_fixer_2 = Custom[Polygon.ByPoints Fixer](VARpoints=scopeIf_7)
create = List.Create(item0=polygon_bypoints_fixer, item1=polygon_bypoints_fixer_2)
code_block_15 = CodeBlock { false; }
clean_5 = List.Clean(list=create, preserveIndices=code_block_15)
flatten_3 = List.Flatten(list=clean_5)
python_null_2_empty = Custom[Python Null 2 Empty](VARIN=flatten_3)  # Python Null 2 Empty
byPatch = Surface.ByPatch(closedCurve=python_null_2_empty)
code_block_16 = CodeBlock { true; }
dynamo_geometry_to_revit = Custom[Dynamo Geometry To Revit Compatibility](VARGeometryOrSat=byPatch, VARPreferImportInstance=code_block_16, VARPreferOneElement=code_block_16)  # Dynamo Geometry To Revit Compatibility
create_2 = List.Create(item0=k_super_quad_paneling.VARAdaptiveComponent, item1=k_super_quad_paneling_2.VARAdaptiveComponent, item2=dynamo_geometry_to_revit)
code_block_17 = CodeBlock { false; }
clean_6 = List.Clean(list=create_2, preserveIndices=code_block_17)
flatten_4 = List.Flatten(list=clean_6)
VAROutput = Output(flatten_4)
