# Dynamo custom node LB.LunchBox Curve to Arcs by Division.dyf (Dynamo 2.1.0.7500)
# category: Synthesize.Packages.LunchBox.Geometry.Rationalize
# Converts a curve to tangent arc segments

VARCurve = Input(VARCurve: var[]..[])
VARDivisions = Input(VARDivisions: var[]..[])
lb_lunchbox_list_matcher = Custom[LB.LunchBox List Matcher](VARListA=VARCurve, VARListB=VARDivisions)  # Compares a List A against a List B and matches length of List A. If ListA > ListB, ListB will be extended. If ListA < ListB, ListB will be truncated.
python_script = Python(IN[0]=lb_lunchbox_list_matcher.VARListA, IN[1]=lb_lunchbox_list_matcher.VARMatchListB)
# ---------- python_script.python (49 lines) ----------
import clr
clr.AddReference('ProtoGeometry')
from Autodesk.DesignScript.Geometry import *
#The inputs to this node will be stored as a list in the IN variable.
curve = IN[0]
division = IN[1]

arcs = []
centers = []
radii = []

for i in range(0, len(curve)):
	a = []
	c = []
	r = []
	
	crv = curve[i]
	div = division[i]
	increment = 1.0 / div
	tan = crv.TangentAtParameter(0)
	for j in range(0, div):
		incstart = increment * j
		incend = increment * (j+1)
		ptstart = crv.PointAtParameter(incstart)
		ptend = crv.PointAtParameter(incend)
		
		#create arc
		arc = Arc.ByStartPointEndPointStartTangent(ptstart,ptend,tan)
		a.append(arc)
		
		#centers
		c.append(arc.CenterPoint)
		
		#radii
		r.append(arc.Radius)
		
		tan = arc.TangentAtParameter(1)
		
	arcs.append(a)
	centers.append(c)
	radii.append(r)

output = []
output.append(arcs)
output.append(centers)
output.append(radii)

#Assign your output to the OUT variable
OUT = output
# ----------------------------------------
number = DoubleInput(0)  # graph input
getItemAtIndex = List.GetItemAtIndex(list=python_script, index=number)
VARArcs = Output(getItemAtIndex)
number_2 = DoubleInput(1)  # graph input
getItemAtIndex_2 = List.GetItemAtIndex(list=python_script, index=number_2)
VARCenters = Output(getItemAtIndex_2)
number_3 = DoubleInput(2)  # graph input
getItemAtIndex_3 = List.GetItemAtIndex(list=python_script, index=number_3)
VARRadii = Output(getItemAtIndex_3)
