# Dynamo custom node LB.LunchBox Mass Addition.dyf (Dynamo 2.1.0.7500)
# category: Synthesize.Packages.LunchBox.Math.Operators
# Returns the total value of a list of numbers.

VARNumbers = Input(VARNumbers: var[]..[])
python_script = Python(IN[0]=VARNumbers)
# ---------- python_script.python (17 lines) ----------
#Copyright(c) 2014, Nathan Miller
# The Proving Ground, http://theprovingground.org
import clr
clr.AddReference('ProtoGeometry')
from Autodesk.DesignScript.Geometry import *

#The input to this node will be stored in the IN[0] variable.
list = IN[0]
mass = 0
if hasattr(list, "__iter__"):
    for i in range(0,len(list)):
	mass = mass + list[i]
else:
    mass = list

#Assign your output to the OUT variable
OUT = mass
# ----------------------------------------
VARResult = Output(python_script)
python_script_2 = Python(IN[0]=VARNumbers)
# ---------- python_script_2.python (19 lines) ----------
#Copyright(c) 2014, Nathan Miller
# The Proving Ground, http://theprovingground.org
import clr
clr.AddReference('ProtoGeometry')
from Autodesk.DesignScript.Geometry import *

#The input to this node will be stored in the IN[0] variable.
list = IN[0]
mass = 0
masspart = []
if hasattr(list, "__iter__"):
    for i in range(0,len(list)):
	mass = mass + list[i]
	masspart.append(mass)
else:
    masspart.append(list)

#Assign your output to the OUT variable
OUT = masspart
# ----------------------------------------
VARPartials = Output(python_script_2)
