# Dynamo custom node LB.LunchBox Multi Face Diamond Grid by Face.dyf (Dynamo 2.1.0.7500)
# category: Synthesize.Packages.LunchBox.Archive.Geometry.Panel
# LB.LunchBox Multi Face Diamond Grid by Face

VARSurface = Input(VARSurface: var[]..[])
flatten = List.Flatten(list=VARSurface)
VARU = Input(VARU: var[]..[])
VARV = Input(VARV: var[]..[])
code_block = CodeBlock { true; }
lb_lunchbox_diamond_grid_by_face = Custom[LB.LunchBox Diamond Grid by Face](VARSurface=flatten, VARU=VARU, VARV=VARV, VARShowPolygons=code_block)  # Create a Diamond XYZ grid on a face. The face surface must have an untrimmed UV parameter space.
transpose = List.Transpose(lists=lb_lunchbox_diamond_grid_by_face.VARAPanelPts)
byPoints = Polygon.ByPoints(points=transpose)
flatten_2 = List.Flatten(list=byPoints)
points = Polygon.Points(polygon=flatten_2)
center = Polygon.Center(polygon=flatten_2)
python_script = Python(IN[0]=center, IN[1]=flatten)
# ---------- python_script.python (17 lines) ----------
# Enable Python support and load DesignScript library
# IMPORTANT : ALL DYNAMO DESIGN SCRIPT NODES ARE AS (dg)
import clr
clr.AddReference('ProtoGeometry')
from Autodesk.DesignScript import Geometry as dg

pts = IN[0]
surfs = IN[1]

wantedsurfs = []
for p in pts:
	dises = []
	for s in surfs:
		dises.append(dg.Geometry.DistanceTo(p,s))
	minD = min(dises)
	wantedsurfs.append(surfs[dises.IndexOf(minD)])
OUT = wantedsurfs
# ----------------------------------------
normalAtPoint = Surface.NormalAtPoint(surface=python_script, point=center)
byOriginNormal = Plane.ByOriginNormal(origin=center, normal=normalAtPoint)
as_pointlist_sortazimuthally = Custom[AS.[&] PointList.SortAzimuthally](VARpoints=points, VARplane=byOriginNormal)  # Sort points azimuthally (like sorting numbers around a clock face) in a plane. Points are ordered about the origin of the plane, proceeding from the positive x-axis of the plane in a counter-clockwise direction about the plane normal vector.
byPoints_2 = Polygon.ByPoints(points=as_pointlist_sortazimuthally.VARpoints)
points_2 = Polygon.Points(polygon=byPoints_2)
VAR4PointsType1 = Output(points_2)
python_script_2 = Python(IN[0]=points_2, IN[1]=flatten)
# ---------- python_script_2.python (76 lines) ----------
# Enable Python support and load DesignScript library
# IMPORTANT : ALL DYNAMO DESIGN SCRIPT NODES ARE AS (dg)
import clr
clr.AddReference('ProtoGeometry')
from Autodesk.DesignScript import Geometry as dg

# EXTENSION Enable ToDSType
clr.AddReference('RevitNodes')
import Revit
clr.ImportExtensions(Revit.Elements)

# Enable Revit Elements
from Revit.Elements import *

# EXTENSION Enable Geometry Conversion Methods
clr.ImportExtensions(Revit.GeometryConversion)

# Enable Revit API
clr.AddReference('RevitAPI')
from Autodesk.Revit.DB import *

# Enable DocumentManager and TransactionManager
clr.AddReference('RevitServices')
from RevitServices.Persistence import DocumentManager
from RevitServices.Transactions import TransactionManager

# Enable ICollection List Translate
clr.AddReference("System")
import System.Collections.Generic
from System.Collections.Generic import List

dataEnteringNode = IN
# Use UnwrapElement(IN[0]) When Translating From Dynamo to Revit
ptsgroups=UnwrapElement(IN[0])
surfs=UnwrapElement(IN[1])

def flatten(x):
    result = []
    for el in x:
        if hasattr(el, "__iter__") and not isinstance(el, basestring):
            result.extend(flatten(el))
        else:
            result.append(el)
    return result

# Choose The Current Document
doc = DocumentManager.Instance.CurrentDBDocument
uidoc = DocumentManager.Instance.CurrentUIApplication.ActiveUIDocument
uiapp = DocumentManager.Instance.CurrentUIApplication
app = uiapp.Application

# Create Empty List
result = []

surfwithpts = []
for s in surfs:
	mp=dg.Surface.PointAtParameter(s,0.5,0.5)
	surfwithpts.append([s,mp])

surfwithptstran = [list(x) for x in zip(*surfwithpts)]

groupednormals = []
for pts in ptsgroups:
	normals = []
	for p in pts:
		dises = []
		for sp in surfwithpts:
			dises.append(dg.Geometry.DistanceTo(p,sp[1]))
		mindis = min(dises)
		wantedindice = dises.IndexOf(mindis)
		wantedsurf = surfwithptstran[0][wantedindice]
		#wantednorm = dg.Surface.NormalAtPoint(wantedsurf,p)
		normals.append(wantedsurf)
	groupednormals.append(normals)
	
OUT = groupednormals
# ----------------------------------------
VAR4PointsType1Surfs = Output(python_script_2)
VARShowPolygons = Input(VARShowPolygons: var[]..[])
empty = List.Empty()
scopeIf = Custom[CW.ScopeIf+](VARtest=VARShowPolygons, VARtrue=empty, VARfalse=lb_lunchbox_diamond_grid_by_face.VARBPolygons)  # A (hopefully) more robust implementation of ScopeIf. Tests a single boolean and returns a value accordingly.
points_3 = Polygon.Points(polygon=scopeIf)
byPerimeterPoints = Surface.ByPerimeterPoints(points=points_3)
flatten_3 = List.Flatten(list=byPerimeterPoints)
area = Surface.Area(surface=flatten_3)
minimumItem = List.MinimumItem(list=area)
code_block_2 = CodeBlock { 2; }
div = minimumItem / code_block_2
python_script_3 = Python(IN[0]=byPerimeterPoints, IN[1]=div)
# ---------- python_script_3.python (133 lines) ----------
# Enable Python support and load DesignScript library
# IMPORTANT : ALL DYNAMO DESIGN SCRIPT NODES ARE AS (dg)
import clr
clr.AddReference('ProtoGeometry')
from Autodesk.DesignScript import Geometry as dg

# EXTENSION Enable ToDSType
clr.AddReference('RevitNodes')
import Revit
clr.ImportExtensions(Revit.Elements)

# Enable Revit Elements
from Revit.Elements import *

# EXTENSION Enable Geometry Conversion Methods
clr.ImportExtensions(Revit.GeometryConversion)

# Enable Revit API
clr.AddReference('RevitAPI')
from Autodesk.Revit.DB import *

# Enable DocumentManager and TransactionManager
clr.AddReference('RevitServices')
from RevitServices.Persistence import DocumentManager
from RevitServices.Transactions import TransactionManager

# Enable ICollection List Translate
clr.AddReference("System")
import System.Collections.Generic
from System.Collections.Generic import List

doc = DocumentManager.Instance.CurrentDBDocument

dataEnteringNode = IN
# Use UnwrapElement(IN[0]) When Translating From Dynamo to Revit
surfsgroups= IN[0]
thickval = IN[1]

if int(DocumentManager.Instance.CurrentUIApplication.Application.VersionNumber) < 2021:
	safefactor = UnitUtils.ConvertFromInternalUnits(0.328084,doc.GetUnits().GetFormatOptions(UnitType.UT_Length).DisplayUnits)
else:
	safefactor = UnitUtils.ConvertFromInternalUnits(0.328084,doc.GetUnits().GetFormatOptions(SpecTypeId.Length).GetUnitTypeId())

if thickval > safefactor:
	thickval = safefactor

def fixlist(lines,surfs):
	newlist = []
	border = []
	excluded = []
	count = 0
	for s in surfs:
		for l in lines:
			try:
				if dg.Geometry.DoesIntersect(s,l):
					excluded.append(count)
					break
			except:
				pass
		count += 1
	count = 0
	for s in surfs:
		if count not in excluded:
			newlist.append(s)
		else:
			border.append(s)
		count += 1
	return newlist,border

def cleansub(surface,solid,counter):
	try:
		result = dg.Surface.SubtractFrom(s,c)[0]
		if counter != 0:
			s.Dispose()
	except:
		result = s
	return result
	
def flatten(x):
    result = []
    for el in x:
        if hasattr(el, "__iter__") and not isinstance(el, basestring):
            result.extend(flatten(el))
        else:
            result.append(el)
    return result

# Choose The Current Document
doc = DocumentManager.Instance.CurrentDBDocument
uidoc = DocumentManager.Instance.CurrentUIApplication.ActiveUIDocument
uiapp = DocumentManager.Instance.CurrentUIApplication
app = uiapp.Application

# Create Empty List
result = []
o_result = []

joined = dg.PolySurface.ByJoinedSurfaces(flatten(surfsgroups))
allcurves = joined.PerimeterCurves()
joined.Dispose()

pts = []
for curve in allcurves:
	pts.append(curve.StartPoint)
pts = dg.Point.PruneDuplicates(flatten(pts))
cuboids = []
bcuboids = []
for p in pts:
	sphere = dg.Sphere.ByCenterPointRadius(p,thickval)
	cuboids.append(sphere)
	bcuboids.append(dg.BoundingBox.ByGeometry(sphere))

for surfs in surfsgroups:
	subbed = []
	o_subbed = []
	for s in surfs:
		o_s = s
		sbox = dg.BoundingBox.ByGeometry(s)
		counter = 0
		for c in cuboids:
			cbox = dg.BoundingBox.ByGeometry(c)
			if dg.BoundingBox.Intersects(cbox,sbox):
				s = cleansub(s,c,counter)
				counter += 1
		subbed.append(s)
		o_subbed.append(o_s)
	result.append(subbed)
	o_result.append(o_subbed)

for c in cuboids:
	c.Dispose()

OUT = result,o_result
# ----------------------------------------
code_block_3 = CodeBlock(a=python_script_3) { a[0]; a[1]; }
flatten_4 = List.Flatten(list=code_block_3.out1)
flatten_5 = List.Flatten(list=code_block_3.out0)
python_script_4 = Python(IN[0]=flatten_5)
# ---------- python_script_4.python (86 lines) ----------
# Enable Python support and load DesignScript library
# IMPORTANT : ALL DYNAMO DESIGN SCRIPT NODES ARE AS (dg)
import clr
clr.AddReference('ProtoGeometry')
from Autodesk.DesignScript import Geometry as dg

# EXTENSION Enable ToDSType
clr.AddReference('RevitNodes')
import Revit
clr.ImportExtensions(Revit.Elements)

# Enable Revit Elements
from Revit.Elements import *

# EXTENSION Enable Geometry Conversion Methods
clr.ImportExtensions(Revit.GeometryConversion)

# Enable Revit API
clr.AddReference('RevitAPI')
from Autodesk.Revit.DB import *

# Enable DocumentManager and TransactionManager
clr.AddReference('RevitServices')
from RevitServices.Persistence import DocumentManager
from RevitServices.Transactions import TransactionManager
clr.AddReference('DynamoRevitDS')
import Dynamo 
# Enable ICollection List Translate
clr.AddReference("System")
import System.Collections.Generic
from System.Collections.Generic import List

dataEnteringNode = IN
# Use UnwrapElement(IN[0]) When Translating From Dynamo to Revit
surfaces = IN[0]

# Choose The Current Document
doc = DocumentManager.Instance.CurrentDBDocument
uidoc = DocumentManager.Instance.CurrentUIApplication.ActiveUIDocument
uiapp = DocumentManager.Instance.CurrentUIApplication
app = uiapp.Application

def tolist(obj1):
	if hasattr(obj1,'__iter__'): return obj1
	else: return [obj1]

def flatten(x):
    result = []
    for el in x:
        if hasattr(el, "__iter__") and not isinstance(el, basestring):
            result.extend(flatten(el))
        else:
            result.append(el)
    return result

def joinsurfs(surfs):
	def surf_doesinter(a,b,tollerance = 0.00001):
		if round(dg.Geometry.DistanceTo(a,b),2) < tollerance:
			return True
		else:
			return False
	crvs = flatten(tolist(surfs))
	crvGroup = [-1 for x in range(len(crvs))]
	crvGroup[0] = 0
	maxGroupNum = 1
	for i in range(len(crvs)):
		if (crvGroup[i] == -1):
			crvGroup[i] = i
		for j in range(len(crvs)):
			try:
				if i != j and surf_doesinter(crvs[i], crvs[j]):
					if (crvGroup[j] == -1):
						crvGroup[j] = crvGroup[i]
					elif (crvGroup[i] != crvGroup[j]):
						oldNum = crvGroup[j]
						for k in range(len(crvs)):
							if (crvGroup[k] == oldNum):
								crvGroup[k] = crvGroup[i]
			except:
				pass
	return crvGroup

surfaces = joinsurfs(surfaces)

# Assign your output to the OUT variable.
OUT = surfaces
# ----------------------------------------
groupByKey = List.GroupByKey(list=flatten_4, keys=python_script_4)
byJoinedSurfaces = PolySurface.ByJoinedSurfaces(surfaces=groupByKey.groups)
perimeterCurves = Surface.PerimeterCurves(surface=byJoinedSurfaces)
as_polycurve_bycurves = Custom[AS.[&] PolyCurve.ByCurves](VARcurves=perimeterCurves)  # Create polycurves from an unordered list of curves.
flatten_6 = List.Flatten(list=as_polycurve_bycurves.VARpolyCurve)
curves = PolyCurve.Curves(polyCurve=flatten_6)
startPoint = Curve.StartPoint(curve=curves)
byPerimeterPoints_2 = Surface.ByPerimeterPoints(points=startPoint)
byPoints_3 = Polygon.ByPoints(points=startPoint)
center_2 = Polygon.Center(polygon=byPoints_3)
closestPointTo = Geometry.ClosestPointTo(geometry=byPerimeterPoints_2, other=center_2)
python_script_5 = Python(IN[0]=center_2, IN[1]=flatten)  # same code as python_script
normalAtPoint_2 = Surface.NormalAtPoint(surface=python_script_5, point=center_2)
byOriginNormal_2 = Plane.ByOriginNormal(origin=closestPointTo, normal=normalAtPoint_2)
byPlane = CoordinateSystem.ByPlane(plane=byOriginNormal_2)
byOrigin = CoordinateSystem.ByOrigin()
transform = Geometry.Transform(geometry=startPoint, fromCoordinateSystem=byPlane, contextCoordinateSystem=byOrigin)
getConvexHull = Custom[CH.Point.GetConvexHull](VARpoints=transform)  # Generate convex hull vertices of group of points
transform_2 = Geometry.Transform(geometry=getConvexHull.VAR3DPoints, fromCoordinateSystem=byOrigin, contextCoordinateSystem=byPlane)
byPerimeterPoints_3 = Surface.ByPerimeterPoints(points=transform_2)
perimeterCurves_2 = Surface.PerimeterCurves(surface=byPerimeterPoints_3)
startPoint_2 = Curve.StartPoint(curve=perimeterCurves_2)
byOriginNormal_3 = Plane.ByOriginNormal(origin=closestPointTo, normal=normalAtPoint_2)
as_pointlist_sortazimuthally_2 = Custom[AS.[&] PointList.SortAzimuthally](VARpoints=startPoint_2, VARplane=byOriginNormal_3)
count = List.Count()  # unwired: list
sortByFunction = List.SortByFunction(list=as_pointlist_sortazimuthally_2.VARpoints, func=count)
groupByFunction = List.GroupByFunction(list=sortByFunction, func=count)
code_block_4 = CodeBlock { 0; 1; 2; }
getItemAtIndex = List.GetItemAtIndex(list=groupByFunction, index=code_block_4.out0)
code_block_5 = CodeBlock { false; }
clean = List.Clean(list=getItemAtIndex, preserveIndices=code_block_5)
VAR3Points = Output(clean)
python_script_6 = Python(IN[0]=as_pointlist_sortazimuthally_2.VARpoints, IN[1]=flatten)
# ---------- python_script_6.python (77 lines) ----------
# Enable Python support and load DesignScript library
# IMPORTANT : ALL DYNAMO DESIGN SCRIPT NODES ARE AS (dg)
import clr
clr.AddReference('ProtoGeometry')
from Autodesk.DesignScript import Geometry as dg

# EXTENSION Enable ToDSType
clr.AddReference('RevitNodes')
import Revit
clr.ImportExtensions(Revit.Elements)

# Enable Revit Elements
from Revit.Elements import *

# EXTENSION Enable Geometry Conversion Methods
clr.ImportExtensions(Revit.GeometryConversion)

# Enable Revit API
clr.AddReference('RevitAPI')
from Autodesk.Revit.DB import *

# Enable DocumentManager and TransactionManager
clr.AddReference('RevitServices')
from RevitServices.Persistence import DocumentManager
from RevitServices.Transactions import TransactionManager

# Enable ICollection List Translate
clr.AddReference("System")
import System.Collections.Generic
from System.Collections.Generic import List

dataEnteringNode = IN
# Use UnwrapElement(IN[0]) When Translating From Dynamo to Revit
ptsgroups=UnwrapElement(IN[0])
surfs=UnwrapElement(IN[1])

def flatten(x):
    result = []
    for el in x:
        if hasattr(el, "__iter__") and not isinstance(el, basestring):
            result.extend(flatten(el))
        else:
            result.append(el)
    return result

# Choose The Current Document
doc = DocumentManager.Instance.CurrentDBDocument
uidoc = DocumentManager.Instance.CurrentUIApplication.ActiveUIDocument
uiapp = DocumentManager.Instance.CurrentUIApplication
app = uiapp.Application

# Create Empty List
result = []

surfwithpts = []
for s in surfs:
	mp=dg.Surface.PointAtParameter(s,0.5,0.5)
	surfwithpts.append([s,mp])

surfwithptstran = [list(x) for x in zip(*surfwithpts)]

groupednormals = []
for pts in ptsgroups:
	normals = []
	for p in pts:
		dises = []
		for sp in surfwithpts:
			#dises.append(dg.Geometry.DistanceTo(p,sp[1]))
			dises.append(dg.Geometry.DistanceTo(p,sp[0]))
		mindis = min(dises)
		wantedindice = dises.IndexOf(mindis)
		wantedsurf = surfwithptstran[0][wantedindice]
		#wantednorm = dg.Surface.NormalAtPoint(wantedsurf,p)
		normals.append(wantedsurf)
	groupednormals.append(normals)
	
OUT = groupednormals
# ----------------------------------------
count_2 = List.Count()  # unwired: list
sortByFunction_2 = List.SortByFunction(list=python_script_6, func=count_2)
groupByFunction_2 = List.GroupByFunction(list=sortByFunction_2, func=count_2)
code_block_6 = CodeBlock { 0; 1; 2; }
getItemAtIndex_2 = List.GetItemAtIndex(list=groupByFunction_2, index=code_block_6.out0)
code_block_7 = CodeBlock { false; }
clean_2 = List.Clean(list=getItemAtIndex_2, preserveIndices=code_block_7)
VAR3PointsSurfs = Output(clean_2)
getItemAtIndex_3 = List.GetItemAtIndex(list=groupByFunction, index=code_block_4.out1)
clean_3 = List.Clean(list=getItemAtIndex_3, preserveIndices=code_block_5)
VAR4PointsType2 = Output(clean_3)
getItemAtIndex_4 = List.GetItemAtIndex(list=groupByFunction_2, index=code_block_6.out1)
clean_4 = List.Clean(list=getItemAtIndex_4, preserveIndices=code_block_7)
VAR4PointsType2Surfs = Output(clean_4)
getItemAtIndex_5 = List.GetItemAtIndex(list=groupByFunction, index=code_block_4.out2)
clean_5 = List.Clean(list=getItemAtIndex_5, preserveIndices=code_block_5)
VAR5Points = Output(clean_5)
getItemAtIndex_6 = List.GetItemAtIndex(list=groupByFunction_2, index=code_block_6.out2)
clean_6 = List.Clean(list=getItemAtIndex_6, preserveIndices=code_block_7)
VAR5PointsSurfs = Output(clean_6)
create = List.Create(item0=byPoints_2, item1=byPoints_3)
code_block_8 = CodeBlock { false; }
clean_7 = List.Clean(list=create, preserveIndices=code_block_8)
flatten_7 = List.Flatten(list=clean_7)
empty_2 = List.Empty()
scopeIf_2 = Custom[CW.ScopeIf+](VARtest=VARShowPolygons, VARtrue=flatten_7, VARfalse=empty_2)
VARPolygons = Output(scopeIf_2)
byStartPointDirectionLength = Line.ByStartPointDirectionLength(startPoint=closestPointTo, direction=normalAtPoint_2)
endPoint = Curve.EndPoint(curve=byStartPointDirectionLength)
normalAtPoint_3 = Surface.NormalAtPoint(surface=byPerimeterPoints_3, point=center_2)  # frozen
byStartPointDirectionLength_2 = Line.ByStartPointDirectionLength(startPoint=closestPointTo, direction=normalAtPoint_3)
endPoint_2 = Curve.EndPoint(curve=byStartPointDirectionLength_2)
flipNormalDirection = Surface.FlipNormalDirection(surface=byPerimeterPoints_3)  # frozen
normalAtPoint_4 = Surface.NormalAtPoint(surface=flipNormalDirection, point=center_2)
byStartPointDirectionLength_3 = Line.ByStartPointDirectionLength(startPoint=closestPointTo, direction=normalAtPoint_4)
endPoint_3 = Curve.EndPoint(curve=byStartPointDirectionLength_3)
python_script_7 = Python(IN[0]=endPoint, IN[1]=endPoint_2, IN[2]=endPoint_3, IN[3]=byPerimeterPoints_3, IN[4]=flipNormalDirection)
# ---------- python_script_7.python (27 lines) ----------
# Enable Python support and load DesignScript library
# IMPORTANT : ALL DYNAMO DESIGN SCRIPT NODES ARE AS (dg)
import clr
clr.AddReference('ProtoGeometry')
from Autodesk.DesignScript import Geometry as dg

originalpts = IN[0]
pts_s1s = IN[1]
pts_s2s = IN[2]
s1s = IN[3]
s2s = IN[4]

result = []
count = 0
for originalpt in originalpts:
	pt_s1 = pts_s1s[count]
	pt_s2 = pts_s2s[count]
	s1 = s1s[count]
	s2 = s2s[count]
	count += 1
	dis1 = dg.Geometry.DistanceTo(originalpt,pt_s1)
	dis2 = dg.Geometry.DistanceTo(originalpt,pt_s2)
	if dis1 < dis2:
		result.append(s1)
	else:
		result.append(s2)
OUT = result
# ----------------------------------------
