# Dynamo custom node LF.Elements.RandomizeParameter.dyf (Dynamo 2.1.0.7500)
# category: Synthesize.Packages.Landform.Revit.Elements.Parameter
# Set an element's instance parameter to a random value between a range specified by the minimum and maximum parameter.

VARelements = Input(VARelements: var[]..[])

# group: Element.Type
code_block = CodeBlock(item=VARelements) { DSCore.List.Flatten([item]); }
python_script = Python(IN[0]=code_block)
# ---------- python_script.python (12 lines) ----------
import clr
clr.AddReference('RevitAPI')
from Autodesk.Revit.DB import *

items = UnwrapElement(IN[0])
typelist = list()
for item in items:
	try: 
		typelist.append(item.Document.GetElement(item.GetTypeId()))
	except:
		typelist.append(list())
OUT = typelist
# ----------------------------------------
python_script_2 = Python(IN[0]=VARelements, IN[1]=python_script)
# ---------- python_script_2.python (4 lines) ----------
check = IN[0]
items = IN[1]
if isinstance(check, (list)): OUT = items
else: OUT = items[0]
# ----------------------------------------

groupByKey = List.GroupByKey(list=VARelements, keys=python_script_2)
VARinstance = Input(VARinstance: string)
VARmin = Input(VARmin: string)
getParameterValueByName = Element.GetParameterValueByName(element=groupByKey.unique_keys, parameterName=VARmin)
VARmax = Input(VARmax: string)
getParameterValueByName_2 = Element.GetParameterValueByName(element=groupByKey.unique_keys, parameterName=VARmax)
count = List.Count()  # unwired: list
map = List.Map(list=groupByKey.groups, f_x=count)
randomIntegerMin = Custom[LF.Math.RandomIntegerMin](VARmin=getParameterValueByName, VARmax=getParameterValueByName_2, VARamount=map)  # Creates a list of random integers between a given minimum and maximum value
setParameterByName = Element.SetParameterByName(element=groupByKey.groups, parameterName=VARinstance, value=randomIntegerMin)
VARElement = Output(setParameterByName)
