# Dynamo custom node LF.IndexOf.Equals.dyf (Dynamo 2.1.0.7500)
# category: Synthesize.Packages.Landform.Core.List
# Returns the indices of items in list B that are equal to items in list A.

VARlistA = Input(VARlistA: var[]..[])
VARlistB = Input(VARlistB: var[]..[])
create_list = List.Create(item0=VARlistA, item1=VARlistB)
python_script = Python(IN[0]=create_list)
# ---------- python_script.python (10 lines) ----------
listaA = IN[0][0]
listaB = IN[0][1]
indiceslist = list()
for lA in listaA:
	counter = 0
	for lB in listaB:
		if (lA == lB):
			indiceslist.append(counter)
		counter += 1
OUT = indiceslist
# ----------------------------------------
VARIndex = Output(python_script)
