# Dynamo custom node LF.Math.RandomIntegerMin.dyf (Dynamo 2.1.0.7500)
# category: Synthesize.Packages.Landform.Core.Math.Create
# Creates a list of random integers between a given minimum and maximum value

VARamount = Input(VARamount: var[]..[])
VARmin = Input(VARmin: var[]..[])
VARmax = Input(VARmax: var[]..[])
code_block = CodeBlock(amount=VARamount, min=VARmin, max=VARmax) { Math.Round(Math.RemapRange(Math.RandomList(amount),min-0.499,max+0.499)); }
VARlist = Output(code_block)
