# Dynamo custom node LF.Point.RandomAmount.dyf (Dynamo 2.1.0.7500)
# category: Synthesize.Packages.Landform.Geometry.Point
# Creates the specified amount of random points within a set boundary curves. Tolerance specifies the minimum distance between points.

VARamount = Input(VARamount: int)
VARcurves = Input(VARcurves: var[]..[])
VARtolerance = Input(VARtolerance: double)
random = Custom[LF.Point.Random](VARamount=VARamount, VARcurves=VARcurves, VARtolerance=VARtolerance)  # Creates a random set of points within a set of boundary cuves. Tolerance specifies the minimum distance between points.
count = List.Count(list=random)
code_block = CodeBlock(amt=VARamount, ct=count) { amt/ct*amt*1.25; }
round = Math.Round(number=code_block)
random_2 = Custom[LF.Point.Random](VARamount=round, VARcurves=VARcurves, VARtolerance=VARtolerance)
takeItems = List.TakeItems(list=random_2, amount=VARamount)
VARPoints = Output(takeItems)
