# Dynamo custom node LF.SlabShape.AdjacentPoints.dyf (Dynamo 2.1.0.7500)
# category: Synthesize.Packages.Landform.Revit.Elements.Floor
# Get the adjacent slab shape points between two adjacent Floors.

VARFloor2 = Input(VARFloor2: var[]..[])
points = Custom[LF.SlabShape.Points](VARFloorOrRoof=VARFloor2)  # Get the XYZ points of any slab shape Roof or Floor.
VARFloor1 = Input(VARFloor1: var[]..[])
points_2 = Custom[LF.SlabShape.Points](VARFloorOrRoof=VARFloor1)
XYZ = Custom[LF.Point.XYZ](VARpoint=points_2)  # Get the X, Y, and Z components of a Point
code_block = CodeBlock { 3; }
round = Math.Round(number=XYZ.VARX, digits=code_block)
round_2 = Math.Round(number=XYZ.VARY, digits=code_block)
byCoordinates = Point.ByCoordinates(x=round, y=round_2)
XYZ_2 = Custom[LF.Point.XYZ](VARpoint=points)
code_block_2 = CodeBlock { 3; }
round_3 = Math.Round(number=XYZ_2.VARX, digits=code_block_2)
round_4 = Math.Round(number=XYZ_2.VARY, digits=code_block_2)
byCoordinates_2 = Point.ByCoordinates(x=round_3, y=round_4)
equals = Custom[LF.IndexOf.Equals](VARlistA=byCoordinates, VARlistB=byCoordinates_2)  # Returns the indices of items in list B that are equal to items in list A.
getItemAtIndex = List.GetItemAtIndex(list=points, index=equals)
VARPoints2 = Output(getItemAtIndex)
sortByXY = Custom[LF.Points.SortByXY](VARpoints=getItemAtIndex)  # Sort list of points based on its X and Y coordinate values. In order to sort correctly, points must be rounded (default value is 3 decimal points).
indexOf = List.IndexOf(list=getItemAtIndex)  # unwired: element
map = List.Map(list=sortByXY.VARXthenY, f_x=indexOf)
VARIndex = Output(map)
equals_2 = Custom[LF.IndexOf.Equals](VARlistA=byCoordinates_2, VARlistB=byCoordinates)
getItemAtIndex_2 = List.GetItemAtIndex(list=points_2, index=equals_2)
sortByXY_2 = Custom[LF.Points.SortByXY](VARpoints=getItemAtIndex_2)
VARPoints1 = Output(sortByXY_2.VARXthenY)
VARIndexOriginal = Output(equals)
