# Dynamo custom node LF.SlabShape.MatchPoints.dyf (Dynamo 2.1.0.7500)
# category: Synthesize.Packages.Landform.Revit.Elements.Floor
# Match the adjacent slab shape points from Floor 1 to Floor 2. (requires Clockwork package)

VARFloor2 = Input(VARFloor2: var[]..[])
points = Custom[LF.SlabShape.Points](VARFloorOrRoof=VARFloor2)  # Get the XYZ points of any slab shape Roof or Floor.
VARFloor1 = Input(VARFloor1: var[]..[])
adjacentPoints = Custom[LF.SlabShape.AdjacentPoints](VARFloor1=VARFloor1, VARFloor2=VARFloor2)  # Get the adjacent slab shape points between two adjacent Floors.
replaceItemAtIndex = Custom[CW.List.ReplaceItemAtIndex+](VARseq=adjacentPoints.VARPoints2, VARindex=adjacentPoints.VARIndex, VARreplacement=adjacentPoints.VARPoints1)  # Replaces the item at a given index (or list of indices) of a list by another item
replaceItemAtIndex_2 = Custom[CW.List.ReplaceItemAtIndex+](VARseq=points, VARindex=adjacentPoints.VARIndexOriginal, VARreplacement=replaceItemAtIndex)
slabShapeByPoints = Custom[CW.Floor.SlabShapeByPoints](VARpoints=replaceItemAtIndex_2, VARfloor=VARFloor2)  # Transform a slab shape based on a list of XYZs. PLEASE NOTE: Will reset any previous edits on the slab shape.
VARfloor = Output(slabShapeByPoints)
