# Dynamo custom node Lines Join and Flatten.dyf (Dynamo 2.1.0.7500)
# category: Synthesize.Automate.Lines
# Joins Lines and Flattens them to Nearest Level

VARExactSameLineIgnoresNumberofControlPo = Input(VARExactSameLineIgnoresNumberofControlPointsDesiredUsefulforConvertingIntoSmartLines: var[]..[])
code_block = CodeBlock { null; }
VARFlattentoNearestLevel = Input(VARFlattentoNearestLevel: var[]..[])
VARCurves = Input(VARCurves: var[]..[])
flatten = List.Flatten(list=VARCurves)
as_polycurve_bycurves = Custom[AS.[&] PolyCurve.ByCurves](VARcurves=flatten)  # Create polycurves from an unordered list of curves.
code_block_2 = CodeBlock { null; }
scopeIf = Custom[CW.ScopeIf+](VARtest=VARFlattentoNearestLevel, VARtrue=as_polycurve_bycurves.VARpolyCurve, VARfalse=code_block_2)  # A (hopefully) more robust implementation of ScopeIf. Tests a single boolean and returns a value accordingly.
create = List.Create(item0=scopeIf)
code_block_3 = CodeBlock { false; }
clean = List.Clean(list=create, preserveIndices=code_block_3)
flatten_2 = List.Flatten(list=clean)
startPoint = Curve.StartPoint(curve=flatten_2)
Z = Point.Z(point=startPoint)
bk_find_nearest_revit_level_for = Custom[BK.Find Nearest Revit Level for a Given Z value](VARzvalue=Z@L1)
flatten_3 = List.Flatten(list=bk_find_nearest_revit_level_for)
code_block_4 = CodeBlock(l=flatten_3) { o = Autodesk.Point.ByCoordinates(0,0,l.Elevation); pl = Plane.ByOriginNormal(o,Vector.ZAxis()); }
pullOntoPlane = Curve.PullOntoPlane(curve=flatten_2, plane=code_block_4.pl, lacing=Longest)
as_polycurve_bycurves_2 = Custom[AS.[&] PolyCurve.ByCurves](VARcurves=pullOntoPlane)
flatten_4 = List.Flatten(list=as_polycurve_bycurves_2.VARpolyCurve)
create_2 = List.Create(item0=flatten_4)
code_block_5 = CodeBlock { false; }
clean_2 = List.Clean(list=create_2, preserveIndices=code_block_5)
flatten_5 = List.Flatten(list=clean_2)
flatten_6 = List.Flatten(list=flatten_5)
code_block_6 = CodeBlock { 0; 1; }
isClosed = Curve.IsClosed(curve=flatten_5)
VARNumberofControlPointsDesired = Input(VARNumberofControlPointsDesired: var[]..[])
count = List.Count(list=flatten_5)
cycle = List.Cycle(list=VARNumberofControlPointsDesired, amount=count)
code_block_7 = CodeBlock { 1; }
add = cycle + code_block_7
scopeIf_2 = Custom[CW.ScopeIf+](VARtest=isClosed, VARtrue=add, VARfalse=cycle)
sequence = Sequence(start=code_block_6.out0, amount=scopeIf_2, step=code_block_6.out1, lacing=Longest)
code_block_8 = CodeBlock { 0; 1; }
remapRange = Math.RemapRange(newMin=code_block_8.out0, newMax=code_block_8.out1)  # unwired: numbers
map = List.Map(list=sequence, f_x=remapRange)
pointAtParameter = Curve.PointAtParameter(curve=flatten_6, param=map)
code_block_9 = CodeBlock { 3; }
VARCloseCurves = Input(VARCloseCurves: var[]..[])
byControlPoints = NurbsCurve.ByControlPoints(degree=code_block_9, closeCurve=VARCloseCurves)  # unwired: points
map_2 = List.Map(list=pointAtParameter, f_x=byControlPoints)
scopeIf_3 = Custom[CW.ScopeIf+](VARtest=VARExactSameLineIgnoresNumberofControlPo, VARtrue=flatten_5, VARfalse=map_2)
scopeIf_4 = Custom[CW.ScopeIf+](VARtest=VARExactSameLineIgnoresNumberofControlPo, VARtrue=code_block, VARfalse=scopeIf_3)
code_block_10 = CodeBlock { null; }
scopeIf_5 = Custom[CW.ScopeIf+](VARtest=VARExactSameLineIgnoresNumberofControlPo, VARtrue=scopeIf_3, VARfalse=code_block_10)
curves = PolyCurve.Curves()  # unwired: polyCurve
map_3 = List.Map(list=scopeIf_5, f_x=curves)
flatten_7 = List.Flatten(list=map_3)
toNurbsCurve = Curve.ToNurbsCurve()  # unwired: curve
map_4 = List.Map(list=flatten_7, f_x=toNurbsCurve)
scopeIf_6 = Custom[CW.ScopeIf+](VARtest=VARExactSameLineIgnoresNumberofControlPo, VARtrue=map_4, VARfalse=code_block)
join = List.Join(list0=scopeIf_4, list1=scopeIf_6)
code_block_11 = CodeBlock { null; false; }
clean_3 = List.Clean(list=join, preserveIndices=code_block_11.out1)
flatten_8 = List.Flatten(list=clean_3)
isClosed_2 = Curve.IsClosed(curve=flatten_8)
filterByBoolMask = List.FilterByBoolMask(list=flatten_8, mask=isClosed_2)
VARSplitNormalizeFactorExactSameLineMust = Input(VARSplitNormalizeFactorExactSameLineMustbeFasleWorksforClosedLoopsOnly: var[]..[])
splitByParameter = Curve.SplitByParameter(curve=filterByBoolMask.in, parameters=VARSplitNormalizeFactorExactSameLineMust)
join_2 = List.Join(list0=filterByBoolMask.out, list1=splitByParameter)
flatten_9 = List.Flatten(list=join_2)
scopeIf_7 = Custom[CW.ScopeIf+](VARtest=VARFlattentoNearestLevel, VARtrue=code_block_2, VARfalse=as_polycurve_bycurves.VARpolyCurve)
create_3 = List.Create(item0=scopeIf_7)
clean_4 = List.Clean(list=create_3, preserveIndices=code_block_3)
flatten_10 = List.Flatten(list=clean_4)
isClosed_3 = Curve.IsClosed(curve=flatten_10)
flatten_11 = List.Flatten(list=flatten_10)
code_block_12 = CodeBlock { 0; 1; }
count_2 = List.Count(list=flatten_10)
cycle_2 = List.Cycle(list=VARNumberofControlPointsDesired, amount=count_2)
code_block_13 = CodeBlock { 1; }
add_2 = cycle_2 + code_block_13
scopeIf_8 = Custom[CW.ScopeIf+](VARtest=isClosed_3, VARtrue=add_2, VARfalse=cycle_2)
sequence_2 = Sequence(start=code_block_12.out0, amount=scopeIf_8, step=code_block_12.out1, lacing=Longest)
code_block_14 = CodeBlock { 0; 1; }
remapRange_2 = Math.RemapRange(newMin=code_block_14.out0, newMax=code_block_14.out1)  # unwired: numbers
map_5 = List.Map(list=sequence_2, f_x=remapRange_2)
pointAtParameter_2 = Curve.PointAtParameter(curve=flatten_11, param=map_5)
code_block_15 = CodeBlock { 1; }
dropItems = List.DropItems(list=pointAtParameter_2@L2, amount=code_block_15)
scopeIf_9 = Custom[CW.ScopeIf+](VARtest=isClosed_3, VARtrue=dropItems, VARfalse=pointAtParameter_2)
byControlPoints_2 = NurbsCurve.ByControlPoints(degree=code_block_9, closeCurve=VARCloseCurves)  # unwired: points
map_6 = List.Map(list=scopeIf_9, f_x=byControlPoints_2)
scopeIf_10 = Custom[CW.ScopeIf+](VARtest=VARExactSameLineIgnoresNumberofControlPo, VARtrue=flatten_10, VARfalse=map_6)
code_block_16 = CodeBlock { null; }
scopeIf_11 = Custom[CW.ScopeIf+](VARtest=VARExactSameLineIgnoresNumberofControlPo, VARtrue=scopeIf_10, VARfalse=code_block_16)
curves_2 = PolyCurve.Curves()  # unwired: polyCurve
map_7 = List.Map(list=scopeIf_11, f_x=curves_2)
flatten_12 = List.Flatten(list=map_7)
toNurbsCurve_2 = Curve.ToNurbsCurve()  # unwired: curve
map_8 = List.Map(list=flatten_12, f_x=toNurbsCurve_2)
scopeIf_12 = Custom[CW.ScopeIf+](VARtest=VARExactSameLineIgnoresNumberofControlPo, VARtrue=map_8, VARfalse=code_block_11.out0)
scopeIf_13 = Custom[CW.ScopeIf+](VARtest=VARExactSameLineIgnoresNumberofControlPo, VARtrue=code_block_11.out0, VARfalse=scopeIf_10)
join_3 = List.Join(list0=scopeIf_12, list1=scopeIf_13)
clean_5 = List.Clean(list=join_3, preserveIndices=code_block_11.out1)
flatten_13 = List.Flatten(list=clean_5)
isClosed_4 = Curve.IsClosed(curve=flatten_13)
filterByBoolMask_2 = List.FilterByBoolMask(list=flatten_13, mask=isClosed_4)
splitByParameter_2 = Curve.SplitByParameter(curve=filterByBoolMask_2.in, parameters=VARSplitNormalizeFactorExactSameLineMust)
join_4 = List.Join(list0=filterByBoolMask_2.out, list1=splitByParameter_2)
flatten_14 = List.Flatten(list=join_4)
create_4 = List.Create(item0=flatten_9, item1=flatten_14)
code_block_17 = CodeBlock { false; }
clean_6 = List.Clean(list=create_4, preserveIndices=code_block_17)
flatten_15 = List.Flatten(list=clean_6)
VARCurves_2 = Output(flatten_15)  # "VARCurves"
