# Dynamo custom node Location Of Any Element With Coordination System.dyf (Dynamo 2.1.0.7500)
# category: Synthesize.Automate.Family
# Location Of Any Element

VARElements = Input(VARElements: var[]..[])
turnIntoList = Custom[CW.TurnIntoList](VARunknownItem=VARElements)  # Turns an element (or a nested list) into a flat list
flatten = List.Flatten(list=turnIntoList)
python_script = Python(IN[0]=flatten)
# ---------- python_script.python (62 lines) ----------
# Enable Python support and load DesignScript library
# IMPORTANT : ALL DYNAMO DESIGN SCRIPT NODES ARE AS (dg)
import clr
clr.AddReference('ProtoGeometry')
from Autodesk.DesignScript import Geometry as dg

# EXTENSION Enable ToDSType
clr.AddReference('RevitNodes')
import Revit
clr.ImportExtensions(Revit.Elements)

# Enable Revit Elements
from Revit.Elements import *

# EXTENSION Enable Geometry Conversion Methods
clr.ImportExtensions(Revit.GeometryConversion)

# Enable Revit API
clr.AddReference('RevitAPI')
from Autodesk.Revit.DB import *

# Enable DocumentManager and TransactionManager
clr.AddReference('RevitServices')
from RevitServices.Persistence import DocumentManager
from RevitServices.Transactions import TransactionManager

# Enable ICollection List Translate
clr.AddReference("System")
import System.Collections.Generic
from System.Collections.Generic import List

dataEnteringNode = IN
# Use UnwrapElement(IN[0]) When Translating From Dynamo to Revit
elems = UnwrapElement(IN[0])

# Choose The Current Document
doc = DocumentManager.Instance.CurrentDBDocument
uidoc = DocumentManager.Instance.CurrentUIApplication.ActiveUIDocument
uiapp = DocumentManager.Instance.CurrentUIApplication
app = uiapp.Application
#app = doc.Application
# Create Empty List
result = []
nonresult = []
adapt = []
for each in elems:
	#TryPatterns
	try:
		e1 = each.GetFamilyPointPlacementReferences()
		e2 = e1[0].PointReference
		e3 = doc.GetElement(e2)
		if e3.ToString() == "Autodesk.Revit.DB.DividedSurface":
			result.append(each)
		elif AdaptiveComponentInstanceUtils.IsAdaptiveComponentInstance(each):
			adapt.append(each)
		else:
			nonresult.append(each)
	except:
		nonresult.append(each)
		
# Assign your output to the OUT variable.
OUT = result, nonresult, adapt
# ----------------------------------------
code_block = CodeBlock(a=python_script) { a[0]; a[1]; a[2]; }
code_block_2 = CodeBlock { "ReferencePoint"; "CurveByPoints"; }
byClassName = Custom[SP.Filter.ByClassName](VARobject=code_block.out1, VARclassName=code_block_2.out0)  # Filters a list of objects by the object's class name. Note that Dynamo elements belong to different classes than their Revit counterparts. Use the Object.Class node to check an object's class.
byClassName_2 = Custom[SP.Filter.ByClassName](VARobject=byClassName.VARout, VARclassName=code_block_2.out1)
location = Custom[CW.Element.Location](VARelement=byClassName_2.VARout)  # Returns the location of an element as an XYZ (or if it's line-based the start and end point of the line), along with some booleans to help filtering the results. Use this for some element types (e.g. walls or lines) that do not work with the built-in Get Family Instance Location node.

# group: In
filterByBoolMask = List.FilterByBoolMask(list=byClassName_2.VARout, mask=location.VARisPoint)

# group: In
filterByBoolMask_2 = List.FilterByBoolMask(list=byClassName_2.VARout, mask=location.VARisCurve)

# group: In
filterByBoolMask_3 = List.FilterByBoolMask(list=code_block.out1, mask=byClassName.VARbool)
point = ReferencePoint.Point(referencePoint=byClassName.VARin)

watch = Watch(code_block.out0)

# group: Out
filterByBoolMask_4 = List.FilterByBoolMask(list=location.VARisCurve, mask=location.VARisPoint)
filterByBoolMask_5 = List.FilterByBoolMask(list=filterByBoolMask.out, mask=filterByBoolMask_4.out)
boundingBox = Element.BoundingBox(element=filterByBoolMask_5.out)

isNull = Object.IsNull(obj=boundingBox)
filterByBoolMask_6 = List.FilterByBoolMask(list=filterByBoolMask_5.out, mask=isNull)
filterByBoolMask_7 = List.FilterByBoolMask(list=byClassName_2.VARin, mask=byClassName_2.VARbool)
create = List.Create(item0=filterByBoolMask.in, item1=filterByBoolMask_2.in, item2=filterByBoolMask_3.in, item3=watch, item4=code_block.out2, item5=filterByBoolMask_6.out, item6=filterByBoolMask_7.in)
code_block_3 = CodeBlock { false; }
clean = List.Clean(list=create, preserveIndices=code_block_3)
flatten_2 = List.Flatten(list=clean)
VARElements_2 = Output(flatten_2)  # "VARElements"
VARGetAllPointsOfAdaptiveComponents = Input(VARGetAllPointsOfAdaptiveComponents: bool = false)
locations = AdaptiveComponent.Locations(adaptiveComponent=code_block.out0)
code_block_4 = CodeBlock { 1; }
unit_types = UnitTypes("Length")  # graph input
displayUnitType = Custom[CW.UnitType.DisplayUnitType](VARunitType=unit_types)  # Retrieves the display unit type for a given unit type.
toDisplayUnit = Custom[CW.InternalUnit.ToDisplayUnit](VARval=code_block_4, VARdisplayUnitType=displayUnitType.VARdisplayUnitType)  # Converts a value from Revit's internal unit to a given display unit
scale = Geometry.Scale(geometry=locations, xamount=toDisplayUnit, yamount=toDisplayUnit, zamount=toDisplayUnit)
byPoints = Polygon.ByPoints(points=scale)
scopeIf = Custom[CW.ScopeIf+](VARtest=VARGetAllPointsOfAdaptiveComponents, VARtrue=scale, VARfalse=byPoints)  # A (hopefully) more robust implementation of ScopeIf. Tests a single boolean and returns a value accordingly.
locations_2 = AdaptiveComponent.Locations(adaptiveComponent=code_block.out2)
python_script_2 = Python(IN[0]=locations_2)
# ---------- python_script_2.python (19 lines) ----------
import clr
clr.AddReference('ProtoGeometry')
from Autodesk.DesignScript import Geometry as dg
#The inputs to this node will be stored as a list in the IN variables.
listofpoints = UnwrapElement(IN[0])

result = []
for eachlist in listofpoints:
	try:
		result.append(dg.Polygon.ByPoints(eachlist))
	except:
		try:
			result.append(dg.PolyCurve.ByPoints(eachlist))
		except:
			result.append(eachlist[0])
	

#Assign your output to the OUT variable.
OUT = result
# ----------------------------------------
scopeIf_2 = Custom[CW.ScopeIf+](VARtest=VARGetAllPointsOfAdaptiveComponents, VARtrue=locations_2, VARfalse=python_script_2)
filterByBoolMask_8 = List.FilterByBoolMask(list=boundingBox, mask=isNull)

# group (continued): Out
centerPoint = Custom[ZK.BoundingBox.CenterPoint](VARBoundingBox=filterByBoolMask_8.out)  # Input Bounding Box element to get its center point. This node is little and lightweight, as it doesn't convert bounding box to geometry to get its centroid point.

curves = Element.Curves(element=filterByBoolMask_7.in)
python_script_3 = Python(IN[0]=location.VARpoints, IN[1]=location.VARcurves, IN[2]=point, IN[3]=scopeIf, IN[4]=scopeIf_2, IN[5]=centerPoint, IN[6]=curves)
# ---------- python_script_3.python (38 lines) ----------
import clr
clr.AddReference('ProtoGeometry')
from Autodesk.DesignScript.Geometry import *
#The inputs to this node will be stored as a list in the IN variables.
dataEnteringNode = IN

ins0 = IN[0]
ins1 = IN[1]
ins2 = IN[2]
ins3 = IN[3]
ins4 = IN[4]
ins5 = IN[5]
ins6 = IN[6]

if ins0 == None:
	ins0 = []

if ins1 == None:
	ins1 = []
	
if ins2 == None:
	ins2 = []
	
if ins3 == None:
	ins3 = []
	
if ins4 == None:
	ins4 = []
	
if ins5 == None:
	ins5 = []
	
if ins6 == None:
	ins6 = []

all = ins0+ins1+ins2+ins3+ins4+ins5+ins6
#Assign your output to the OUT variable.
OUT = all
# ----------------------------------------
VARFalseBasePointTrueSurveyPoint = Input(VARFalseBasePointTrueSurveyPoint: bool = false)
surveyPoint = Coordinates.SurveyPoint()
byOrigin = CoordinateSystem.ByOrigin(origin=surveyPoint)
ZAxis = Vector.ZAxis()
projectRotation = Coordinates.ProjectRotation()
rotate = CoordinateSystem.Rotate(coordinateSystem=byOrigin, origin=surveyPoint, axis=ZAxis, degrees=projectRotation)
basePoint = Coordinates.BasePoint()
byOrigin_2 = CoordinateSystem.ByOrigin(origin=basePoint)
scopeIf_3 = Custom[CW.ScopeIf+](VARtest=VARFalseBasePointTrueSurveyPoint, VARtrue=rotate, VARfalse=byOrigin_2)
origin = Point.Origin()
byOrigin_3 = CoordinateSystem.ByOrigin(origin=origin)
transform = Geometry.Transform(geometry=python_script_3, fromCoordinateSystem=scopeIf_3, contextCoordinateSystem=byOrigin_3)
VARLocations = Output(transform)
python_script_4 = Python(IN[0]=flatten_2)
# ---------- python_script_4.python (55 lines) ----------
# Enable Python support and load DesignScript library
# IMPORTANT : ALL DYNAMO DESIGN SCRIPT NODES ARE AS (dg)
import clr
clr.AddReference('ProtoGeometry')
from Autodesk.DesignScript import Geometry as dg

# EXTENSION Enable ToDSType
clr.AddReference('RevitNodes')
import Revit
clr.ImportExtensions(Revit.Elements)

# Enable Revit Elements
from Revit.Elements import *

# EXTENSION Enable Geometry Conversion Methods
clr.ImportExtensions(Revit.GeometryConversion)

# Enable Revit API
clr.AddReference('RevitAPI')
from Autodesk.Revit.DB import *

# Enable DocumentManager and TransactionManager
clr.AddReference('RevitServices')
from RevitServices.Persistence import DocumentManager
from RevitServices.Transactions import TransactionManager

# Enable ICollection List Translate
clr.AddReference("System")
import System.Collections.Generic
from System.Collections.Generic import List

def tolist(obj1):
	if hasattr(obj1,'__iter__'): return obj1
	else: return [obj1]

dataEnteringNode = IN
# Use UnwrapElement(IN[0]) When Translating From Dynamo to Revit
elems = UnwrapElement(tolist(IN[0]))

# Choose The Current Document
doc = DocumentManager.Instance.CurrentDBDocument
uidoc = DocumentManager.Instance.CurrentUIApplication.ActiveUIDocument
uiapp = DocumentManager.Instance.CurrentUIApplication
app = uiapp.Application

# Create Empty List
result = []

for e in elems:
	try:
		result.append(e.GetTransform().ToCoordinateSystem())
	except:
		result.append(None)
# Assign your output to the OUT variable.
OUT = result
# ----------------------------------------
XAxis = CoordinateSystem.XAxis(coordinateSystem=python_script_4)
YAxis = CoordinateSystem.YAxis(coordinateSystem=python_script_4)
ZAxis_2 = CoordinateSystem.ZAxis(coordinateSystem=python_script_4)
byOriginVectors = CoordinateSystem.ByOriginVectors(origin=python_script_3, xAxis=XAxis, yAxis=YAxis, zAxis=ZAxis_2)
transform_2 = CoordinateSystem.Transform(coordinateSystem=byOriginVectors, fromCoordinateSystem=scopeIf_3, contextCoordinateSystem=byOrigin_3)
VARCoordinationSystems = Output(transform_2)
