# Dynamo custom node MAD.View.SetCropBoxCurves.dyf (Dynamo 2.1.0.7500)
# category: Synthesize.Packages.MEPover.Revit.View
# Input views and lists of curves to set the view crop regions

VARViews = Input(VARViews: var[]..[])
VARCurves = Input(VARCurves: var[]..[])
isNull = Object.IsNull(obj=VARCurves)
firstItem = List.FirstItem(list=isNull@L2)
filterByBoolMask = List.FilterByBoolMask(list=VARViews, mask=firstItem)
filterByBoolMask_2 = List.FilterByBoolMask(list=VARCurves, mask=firstItem)
python_script = Python(IN[0]=filterByBoolMask.out, IN[1]=filterByBoolMask_2.out)
# ---------- python_script.python (67 lines) ----------
import clr
clr.AddReference('ProtoGeometry')
from Autodesk.DesignScript.Geometry import *

import clr
clr.AddReference('RevitAPI')
import Autodesk.Revit.DB

import clr
clr.AddReference("RevitNodes")
import Revit

clr.AddReference('DSCoreNodes')
import DSCore
from DSCore import *

clr.AddReference("RevitServices")
import RevitServices
from RevitServices.Persistence import DocumentManager
from RevitServices.Transactions import TransactionManager
doc = DocumentManager.Instance.CurrentDBDocument

# Import ToProtoType, ToRevitType geometry conversion extension methods
clr.ImportExtensions(Revit.GeometryConversion)

#The inputs to this node will be stored as a list in the IN variables.
if isinstance(IN[0], list):
	views = UnwrapElement(IN[0])
else:
	views = [UnwrapElement(IN[0])]
if isinstance(IN[1], list):
	if IN[1][0].GetType() == PolyCurve:
		curves = [PolyCurve.Curves(x) for x in IN[1]]
	elif IN[1][0].GetType() == Curve or IN[1][0].GetType() == Line:
		curves = List.OfRepeatedItem(IN[1],len(views))
	else:
		curves = IN[1]
else:
	if IN[1].GetType() == PolyCurve:
		curves = [PolyCurve.Curves(IN[1])]
	else:
		curves = [IN[1]]
	
listout = []
for view,curve in zip(views,curves):
	regionMan = view.GetCropRegionShapeManager()
	try:
		revit_curve = [c.ToRevitType() for c in curve]
		curveloop = Autodesk.Revit.DB.CurveLoop()
	except:
		pass
	for c in revit_curve:
		curveloop.Append(c)
	TransactionManager.Instance.EnsureInTransaction(doc)
	if view.CropBoxActive == False:
		view.CropBoxActive = True
		view.CropBoxVisible = True
	try:
		regionMan.SetCropShape(curveloop)
	except:
		listout.append(None)
	TransactionManager.Instance.TransactionTaskDone()
	listout.append(view)


#Assign your output to the OUT variable.
OUT = listout
# ----------------------------------------
code_block = CodeBlock { false; }
clean = List.Clean(list=python_script, preserveIndices=code_block)
VARViews_2 = Output(clean)  # "VARViews"
code_block_2 = CodeBlock { null; }
hot_index_of_item = Custom[HOT.Index of item](VARList=python_script, VARItem=code_block_2)  # Index of Item on List
code_block_3 = CodeBlock { 1; }
add = hot_index_of_item + code_block_3
itemAtIndex = Custom[SP.List.ItemAtIndex+](VARlist=python_script, VARindex=add)  # Identical to the built in node but works with negative indices
create = List.Create(item0=filterByBoolMask.in, item1=itemAtIndex)
clean_2 = List.Clean(list=create, preserveIndices=code_block)
flatten = List.Flatten(list=clean_2)
VARFailedViews = Output(flatten)
