# Dynamo custom node MOD.Get Element Rotation.dyf (Dynamo 2.1.0.7500)
# category: Synthesize.Packages.Modelical.Elements
# Get the rotation of a family instance whose location is a point.

VARFamInstance = Input(VARFamInstance: var[]..[])
python_script = Python(IN[0]=VARFamInstance)
# ---------- python_script.python (32 lines) ----------
# This node has been made by Modelical
# www.modelical.com

import clr
clr.AddReference('ProtoGeometry')
from Autodesk.DesignScript.Geometry import *

# Import RevitAPI
clr.AddReference('RevitAPI')
import Autodesk
#The inputs to this node will be stored as a list in the IN variable.

def toList(input):
	if isinstance(input,list) == False:
		return [input]
	else:
		return input

elements = toList(UnwrapElement(IN[0]))

outlist = [] #export list
templist = [] #temporary list to group attributes by element
for i in elements:
	templist.append(i.HandOrientation) #vector XYZ Hand
	templist.append(i.FacingFlipped) #is mirrored over X axis?
	templist.append(i.HandFlipped) #is mirrored over Y axis?
	outlist.append(templist[:])

	del templist[:] #clear the templist

#Assign your output to the OUT variable
OUT = outlist
# ----------------------------------------
transpose = List.Transpose(lists=python_script)
code_block = CodeBlock(list=transpose) { XYZvectorHand = list[0]; xMirrored = list[1]; yMirrored = list[2]; }
python_script_2 = Python(IN[0]=code_block.XYZvectorHand)
# ---------- python_script_2.python (24 lines) ----------
import clr
clr.AddReference('ProtoGeometry')
from Autodesk.DesignScript.Geometry import *
#The inputs to this node will be stored as a list in the IN variable.
vect = IN[0]
outlist = []
templist = []

for e in vect:
	e = str(e)
	e = e.replace('(', '')
	e = e.replace(')', '')
	e = e.replace(',', '')
	templist.append(e)

for i in templist:
	outlist.append(i.split(" "))
	
for e in outlist:
	for i in e:
		i = float(i)

#Assign your output to the OUT variable
OUT = outlist
# ----------------------------------------
transpose_list_and_split_output = CodeBlock(inputlist=python_script_2) { IN=List.Transpose(inputlist); X=IN[0]; Y=IN[1]; Z=IN[2]; }
toNumber = String.ToNumber(str=transpose_list_and_split_output.X)
toNumber_2 = String.ToNumber(str=transpose_list_and_split_output.Y)
python_script_3 = Python(IN[0]=toNumber, IN[1]=toNumber_2)
# ---------- python_script_3.python (37 lines) ----------
# This node has been made by Modelical
# www.modelical.com

import clr
from math import *
clr.AddReference('ProtoGeometry')
from Autodesk.DesignScript.Geometry import *
#The inputs to this node will be stored as a list in the IN variable.
dataEnteringNode = IN
X=IN[0]
Y=IN[1]
outlist = []
templist = []
templist2 = []
count = 0


for e in X:
	templist.append((acos(e)))


while count < len(templist):
#for item in templist:
	if Y[count] >= 0:
		templist2.append(degrees(templist[count]))
	elif Y[count] < 0:
		templist2.append((degrees(templist[count])) + (2*(180-(degrees(templist[count])))))
	count = count + 1

for e in templist2:
	if e == 0:
		outlist.append(0)
	else:
		outlist.append(360 - e)

#Assign your output to the OUT variable
OUT = outlist
# ----------------------------------------
VARRotation = Output(python_script_3)
watch_isxmirrored = Watch(code_block.xMirrored)
VARisXmirrored = Output(watch_isxmirrored)
watch_isymirrored = Watch(code_block.yMirrored)
VARisYmirrored = Output(watch_isymirrored)
