# Dynamo custom node MOD.Get Views By Type.dyf (Dynamo 2.1.0.7500)
# category: Synthesize.Packages.Modelical.Views
# Get all views in the project classified by type

python_script = Python()  # graph input
# ---------- python_script.python (100 lines) ----------
#Copyright(c) 2014, Konrad Sobon
# @arch_laboratory, http://archi-lab.net
 
import clr
clr.AddReference('ProtoGeometry')
from Autodesk.DesignScript.Geometry import *
 
# Import DocumentManager and TransactionManager
clr.AddReference("RevitServices")
import RevitServices
from RevitServices.Persistence import DocumentManager
from RevitServices.Transactions import TransactionManager
 
# Import RevitAPI
clr.AddReference("RevitAPI")
import Autodesk
from Autodesk.Revit.DB import *
 
doc = DocumentManager.Instance.CurrentDBDocument
uiapp = DocumentManager.Instance.CurrentUIApplication
app = uiapp.Application
 
from System.Collections.Generic import *
 
# Import ToDSType(bool) extension method
clr.AddReference("RevitNodes")
import Revit
clr.ImportExtensions(Revit.Elements)
 
#The inputs to this node will be stored as a list in the IN variable.
dataEnteringNode = IN
 
#collect all views in the model
collector = FilteredElementCollector(doc)
views = collector.OfClass(View).ToElements()
 
#sort views into separate lists based on view type
areaPlans, ceilingPlans, columnSchedules = [], [], []
costReport, details, draftingViews = [], [], []
drawingSheets, elevations, engineetingPlans = [], [], []
floorPlans, internal, legends, loadReports = [], [], [], []
panelSchedules, pressureLossReports, renderings = [], [], []
reports, schedules, sections, threeD = [], [], [], []
undefined, walkthrough = [], []
for i in views:
	if not i.IsTemplate:
		if i.ViewType == ViewType.AreaPlan:
			areaPlans.append(i.ToDSType(True))
		elif i.ViewType == ViewType.CeilingPlan:
			ceilingPlans.append(i.ToDSType(True))
		elif i.ViewType == ViewType.ColumnSchedule:
			columnSchedules.append(i.ToDSType(True))
		elif i.ViewType == ViewType.CostReport:
			costReport.append(i.ToDSType(True))
		elif i.ViewType == ViewType.Detail:
			details.append(i.ToDSType(True))
		elif i.ViewType == ViewType.DraftingView:
			draftingViews.append(i.ToDSType(True))
		elif i.ViewType == ViewType.DrawingSheet:
			drawingSheets.append(i.ToDSType(True))
		elif i.ViewType == ViewType.Elevation:
			elevations.append(i.ToDSType(True))
		elif i.ViewType == ViewType.EngineeringPlan:
			engineetingPlans.append(i.ToDSType(True))
		elif i.ViewType == ViewType.FloorPlan:
			floorPlans.append(i.ToDSType(True))
		elif i.ViewType == ViewType.Internal:
			internal.append(i.ToDSType(True))
		elif i.ViewType == ViewType.Legend:
			legends.append(i.ToDSType(True))
		elif i.ViewType == ViewType.LoadsReport:
			loadReports.append(i.ToDSType(True))
		elif i.ViewType == ViewType.PanelSchedule:
			panelSchedules.append(i.ToDSType(True))
		elif i.ViewType == ViewType.PresureLossReport:
			pressureLossReports.append(i.ToDSType(True))
		elif i.ViewType == ViewType.Rendering:
			renderings.append(i.ToDSType(True))
		elif i.ViewType == ViewType.Report:
			reports.append(i.ToDSType(True))
		elif i.ViewType == ViewType.Schedule:
			schedules.append(i.ToDSType(True))
		elif i.ViewType == ViewType.Section:
			sections.append(i.ToDSType(True))
		elif i.ViewType == ViewType.ThreeD:
			threeD.append(i.ToDSType(True))
		elif i.ViewType == ViewType.Undefined:
			undefined.append(i.ToDSType(True))
		elif i.ViewType == ViewType.Walkthrough:
			walkthrough.append(i.ToDSType(True))
		else:
			continue
 
#Assign your output to the OUT variable
OUT = areaPlans, ceilingPlans, columnSchedules, costReport, \
	details, draftingViews, drawingSheets, elevations, \
	engineetingPlans, floorPlans, internal, legends, \
	loadReports, panelSchedules, pressureLossReports, \
	renderings, reports, schedules, sections, threeD, \
	undefined, walkthrough
# ----------------------------------------
code_block = CodeBlock(list=python_script)
# ---------- code_block.designscript (22 lines) ----------
areaPlans = List.GetItemAtIndex(list, 0);
ceilingPlans = List.GetItemAtIndex(list, 1);
columnSchedules = List.GetItemAtIndex(list, 2);
costReport = List.GetItemAtIndex(list, 3);
details = List.GetItemAtIndex(list, 4);
draftingViews = List.GetItemAtIndex(list, 5);
drawingSheets = List.GetItemAtIndex(list, 6);
elevations = List.GetItemAtIndex(list, 7);
engineeringPlans = List.GetItemAtIndex(list, 8);
floorPlans = List.GetItemAtIndex(list, 9);
internal = List.GetItemAtIndex(list, 10);
legends = List.GetItemAtIndex(list, 11);
loadReports = List.GetItemAtIndex(list, 12);
panelSchedules = List.GetItemAtIndex(list, 13);
pressureLossReports = List.GetItemAtIndex(list, 14);
renderings = List.GetItemAtIndex(list, 15);
reports = List.GetItemAtIndex(list, 16);
schedules = List.GetItemAtIndex(list, 17);
sections = List.GetItemAtIndex(list, 18);
threeD = List.GetItemAtIndex(list, 19);
undefined = List.GetItemAtIndex(list, 20);
walkthrough = List.GetItemAtIndex(list, 21);
# ----------------------------------------
VARareaPlans = Output(code_block.areaPlans)
VARceilingPlans = Output(code_block.ceilingPlans)
VARfloorPlans = Output(code_block.floorPlans)
VARloadReports = Output(code_block.loadReports)
VARrenderings = Output(code_block.renderings)
VARcolumnSchedules = Output(code_block.columnSchedules)
VARdraftingViews = Output(code_block.draftingViews)
VARelevations = Output(code_block.elevations)
VARinternal = Output(code_block.internal)
VARpanelSchedules = Output(code_block.panelSchedules)
VARreports = Output(code_block.reports)
VARcostReport = Output(code_block.costReport)
VARdrawingSheets = Output(code_block.drawingSheets)
VARengineeringPlans = Output(code_block.engineeringPlans)
VARlegends = Output(code_block.legends)
VARpressureLossReports = Output(code_block.pressureLossReports)
VARschedules = Output(code_block.schedules)
VARdetails = Output(code_block.details)
VARsections = Output(code_block.sections)
VARthreeD = Output(code_block.threeD)
VARundefined = Output(code_block.undefined)
VARwalkthrough = Output(code_block.walkthrough)
