# Dynamo custom node Mass Split Updater.dyf (Dynamo 2.1.0.7500)
# category: Synthesize.Automate.Family
# Mass Split Updater

hot_get_all_filter = Custom[HOT.Get All Filter]()  # Get all Filter
string_from_object = FromObject(obj=hot_get_all_filter.VARElement)
code_block = CodeBlock { "SelectionFilterElement"; }
eq = string_from_object == code_block
filterByBoolMask = List.FilterByBoolMask(list=hot_get_all_filter.VARElement, mask=eq)
elements = Custom[CW.SelectionSet.Elements](VARselectionSet=filterByBoolMask.in)  # Retrieves all elements stored in a selection set
isEmpty = List.IsEmpty(list=elements, lacing=Longest)
filterByBoolMask_2 = List.FilterByBoolMask(list=filterByBoolMask.in, mask=isEmpty)
python_all_elements_in_active = Custom[Python All Elements In Active View]()  # Python All Elements In Active View
elements_2 = Custom[CW.SelectionSet.Elements](VARselectionSet=filterByBoolMask_2.out)
contains = List.Contains(list=python_all_elements_in_active, item=elements_2@@L1)
anyTrue = Custom[CW.List.AnyTrue](VARseq=contains)  # Returns true if any item in a list of booleans is true.
filterByBoolMask_3 = List.FilterByBoolMask(list=filterByBoolMask_2.out, mask=anyTrue)
filterByBoolMask_4 = List.FilterByBoolMask(list=hot_get_all_filter.VARName, mask=eq)
filterByBoolMask_5 = List.FilterByBoolMask(list=filterByBoolMask_4.in, mask=isEmpty)
filterByBoolMask_6 = List.FilterByBoolMask(list=filterByBoolMask_5.out, mask=anyTrue)
code_block_2 = CodeBlock { "DONOTDELETE-DYNAMOSPLIT"; }
contains_2 = String.Contains(str=filterByBoolMask_6.in, searchFor=code_block_2)
filterByBoolMask_7 = List.FilterByBoolMask(list=filterByBoolMask_3.in, mask=contains_2)
elements_3 = Custom[CW.SelectionSet.Elements](VARselectionSet=filterByBoolMask_7.in)
isEmpty_2 = List.IsEmpty(list=elements_3, lacing=Longest)
filterByBoolMask_8 = List.FilterByBoolMask(list=filterByBoolMask_7.in, mask=isEmpty_2)
eraser = Custom[ST.Tool.Eraser](VARList=filterByBoolMask_8.in)  # Try to delete any element from project
join = List.Join()  # unwired: list0, list1
filterByBoolMask_9 = List.FilterByBoolMask(list=filterByBoolMask_6.in, mask=contains_2)
filterByBoolMask_10 = List.FilterByBoolMask(list=filterByBoolMask_9.in, mask=isEmpty_2)
code_block_3 = CodeBlock { ","; }
split = String.Split(str=filterByBoolMask_10.out, separator0=code_block_3)
code_block_4 = CodeBlock { 1; "_"; }
getItemAtIndex = List.GetItemAtIndex(list=split@@L2, index=code_block_4.out0)
split_2 = String.Split(str=getItemAtIndex, separator0=code_block_4.out1)
firstItem = List.FirstItem(list=split_2@L2)
code_block_5 = CodeBlock { "-"; }
split_3 = String.Split(str=firstItem, separator0=code_block_5)
toNumber = String.ToNumber(str=split_3)
byID = Custom[CW.Element.ByID](VARIDUniqueId=toNumber@L2)  # Gets the Revit element(s) for a list of IDs (or a single ID). Optionally retrieves elements from linked documents as well.
isNull = Object.IsNull(obj=byID)
anyFalse = Custom[CW.List.AnyFalse](VARseq=isNull)  # Returns true if any item in a list of booleans is false.
lastItem = List.LastItem(list=split_2@L2)
code_block_6 = CodeBlock { "-"; }
split_4 = String.Split(str=lastItem, separator0=code_block_6)
toNumber_2 = String.ToNumber(str=split_4)
byID_2 = Custom[CW.Element.ByID](VARIDUniqueId=toNumber_2@L2)
isNull_2 = Object.IsNull(obj=byID_2)
anyFalse_2 = Custom[CW.List.AnyFalse](VARseq=isNull_2)
combine = List.Combine(comb=join, list1=anyFalse, list2=anyFalse_2)
allTrue = List.AllTrue(list=combine, lacing=Longest)
filterByBoolMask_11 = List.FilterByBoolMask(list=filterByBoolMask_8.out, mask=allTrue)
eraser_2 = Custom[ST.Tool.Eraser](VARList=filterByBoolMask_11.out)
filterByBoolMask_12 = List.FilterByBoolMask(list=filterByBoolMask_10.out, mask=allTrue)
code_block_7 = CodeBlock { false; }
clean = List.Clean(list=filterByBoolMask_11.in, preserveIndices=code_block_7)
flatten = List.Flatten(list=clean)
elements_4 = Custom[CW.SelectionSet.Elements](VARselectionSet=filterByBoolMask_11.in)
clean_2 = List.Clean(list=elements_4, preserveIndices=code_block_7)
flatten_2 = List.Flatten(list=clean_2)
eraser_3 = Custom[ST.Tool.Eraser](VARList=flatten_2)
passthrough = Custom[CW.Passthrough](VARpassThrough=flatten, VARwaitFor=eraser_3)  # Forces a sequential order of execution. The node wired into the output of the Passthrough node will be executed *after* the node wired into the waitFor input (e.g. important for some Revit operations). The value of the passThrough input will be passed on to the node wired into the output port of the Passthrough node.
eraser_4 = Custom[ST.Tool.Eraser](VARList=passthrough)
VARSplitterThickness = Input(VARSplitterThickness: double)
VARDetectionTollerance = Input(VARDetectionTollerance: double)
VARSplitExtendDistance = Input(VARSplitExtendDistance: double)
VARPointsDistancing = Input(VARPointsDistancing: double)
VARPullOrNot = Input(VARPullOrNot: bool)
filterByBoolMask_13 = List.FilterByBoolMask(list=byID, mask=allTrue)
filterByBoolMask_14 = List.FilterByBoolMask(list=byID_2, mask=allTrue)
mass_split = Custom[Mass Split](VARSplitterThickness=VARSplitterThickness, VARDetectionTollerance=VARDetectionTollerance, VARSplitExtendDistance=VARSplitExtendDistance, VARPointsDistancing=VARPointsDistancing, VARPullOrNot=VARPullOrNot, VARElements=filterByBoolMask_13.in, VARSplittingLines=filterByBoolMask_14.in, lacing=Longest)  # Mass Split
flatten_3 = List.Flatten(list=mass_split)
VARGeometry = Output(flatten_3)
eraser_5 = Custom[ST.Tool.Eraser](VARList=filterByBoolMask_2.in)
flatten_4 = List.Flatten(list=filterByBoolMask_13.in)
VARElements = Output(flatten_4)
flatten_5 = List.Flatten(list=filterByBoolMask_14.in)
VASplitters = Output(flatten_5)
