# Dynamo custom node Mirrored Elements Detect.dyf (Dynamo 2.1.0.7500)
# category: Synthesize.Automate.Family
# Mirrored Elements Detect

VARElements = Input(VARElements: var[]..[])
mod_get_element_rotation = Custom[MOD.Get Element Rotation](VARFamInstance=VARElements@L1)  # Get the rotation of a family instance whose location is a point.
flatten = List.Flatten(list=mod_get_element_rotation.VARisXmirrored)
filterByBoolMask = List.FilterByBoolMask(list=VARElements, mask=flatten)
flatten_2 = List.Flatten(list=filterByBoolMask.in)
getType = FamilyInstance.GetType(familyInstance=flatten_2)
VARAutoPlaceFamilyWithCorrectOrientation = Input(VARAutoPlaceFamilyWithCorrectOrientation: var[]..[])
location = FamilyInstance.Location(familyInstance=flatten_2)
code_block = CodeBlock { null; false; }
scopeIf = Custom[CW.ScopeIf+](VARtest=VARAutoPlaceFamilyWithCorrectOrientation, VARtrue=location, VARfalse=code_block.out0)  # A (hopefully) more robust implementation of ScopeIf. Tests a single boolean and returns a value accordingly.
clean = List.Clean(list=scopeIf, preserveIndices=code_block.out1)
byPoint = FamilyInstance.ByPoint(familyType=getType, point=clean)
flatten_3 = List.Flatten(list=mod_get_element_rotation.VARRotation)
filterByBoolMask_2 = List.FilterByBoolMask(list=flatten_3, mask=flatten)
code_block_2 = CodeBlock { 180; }
sub = filterByBoolMask_2.in - code_block_2
setRotation = FamilyInstance.SetRotation(familyInstance=byPoint, degree=sub)
setLocation = Element.SetLocation(element=setRotation, geometry=location)
flatten_4 = List.Flatten(list=mod_get_element_rotation.VARisYmirrored)
filterByBoolMask_3 = List.FilterByBoolMask(list=VARElements, mask=flatten_4)
flatten_5 = List.Flatten(list=filterByBoolMask_3.in)
getType_2 = FamilyInstance.GetType(familyInstance=flatten_5)
location_2 = FamilyInstance.Location(familyInstance=flatten_5)
code_block_3 = CodeBlock { null; false; }
scopeIf_2 = Custom[CW.ScopeIf+](VARtest=VARAutoPlaceFamilyWithCorrectOrientation, VARtrue=location_2, VARfalse=code_block_3.out0)
clean_2 = List.Clean(list=scopeIf_2, preserveIndices=code_block_3.out1)
byPoint_2 = FamilyInstance.ByPoint(familyType=getType_2, point=clean_2)
filterByBoolMask_4 = List.FilterByBoolMask(list=flatten_3, mask=flatten_4)
sub_2 = filterByBoolMask_4.in - code_block_2
setRotation_2 = FamilyInstance.SetRotation(familyInstance=byPoint_2, degree=sub_2)
setLocation_2 = Element.SetLocation(element=setRotation_2, geometry=location_2)
VARDeleteOldWillNotCreateaSelectionFilte = Input(VARDeleteOldWillNotCreateaSelectionFilterifActivated: var[]..[])
VARCreateSelectionFilter = Input(VARCreateSelectionFilter: var[]..[])
code_block_4 = CodeBlock { true; false; }
create = List.Create(item0=flatten_2, item1=flatten_5)
code_block_5 = CodeBlock { false; }
clean_3 = List.Clean(list=create, preserveIndices=code_block_5)
flatten_6 = List.Flatten(list=clean_3)
isEmpty = List.IsEmpty(list=flatten_6)
scopeIf_3 = Custom[CW.ScopeIf+](VARtest=isEmpty, VARtrue=code_block_4.out1, VARfalse=code_block_4.out0)
scopeIf_4 = Custom[CW.ScopeIf+](VARtest=VARDeleteOldWillNotCreateaSelectionFilte, VARtrue=code_block_4.out1, VARfalse=scopeIf_3)
code_block_6 = CodeBlock { false; }
scopeIf_5 = Custom[CW.ScopeIf+](VARtest=VARCreateSelectionFilter, VARtrue=scopeIf_4, VARfalse=code_block_6)
VARFilterNametoCreate = Input(VARFilterNametoCreate: var[]..[])
VAROverwriteExistingFilter = Input(VAROverwriteExistingFilter: var[]..[])
generate_selection_filter = Custom[Generate Selection Filter](VARCreateSelectionFilter=scopeIf_5, VARFilterNametoCreate=VARFilterNametoCreate, VAROverwriteExistingFilter=VAROverwriteExistingFilter, VARElements=flatten_6)  # Generate Selection FIlter
passthrough = Custom[CW.Passthrough](VARpassThrough=flatten_5, VARwaitFor=generate_selection_filter.VARSelectionSet)  # Forces a sequential order of execution. The node wired into the output of the Passthrough node will be executed *after* the node wired into the waitFor input (e.g. important for some Revit operations). The value of the passThrough input will be passed on to the node wired into the output port of the Passthrough node.
passthrough_2 = Custom[CW.Passthrough](VARpassThrough=flatten_2, VARwaitFor=generate_selection_filter.VARSelectionSet)
create_2 = List.Create(item0=passthrough, item1=passthrough_2)
clean_4 = List.Clean(list=create_2, preserveIndices=code_block_4.out1)
flatten_7 = List.Flatten(list=clean_4)
code_block_7 = CodeBlock { null; }
scopeIf_6 = Custom[CW.ScopeIf+](VARtest=VARDeleteOldWillNotCreateaSelectionFilte, VARtrue=flatten_7, VARfalse=code_block_7)
clean_5 = List.Clean(list=scopeIf_6, preserveIndices=code_block_4.out1)
eraser = Custom[ST.Tool.Eraser](VARList=clean_5)  # Try to delete any element from project
VARCantdeleteIds = Output(eraser)
VAROldElements = Output(generate_selection_filter.VARElements)
VARSelectionSet = Output(generate_selection_filter.VARSelectionSet)
create_3 = List.Create(item0=byPoint, item1=byPoint_2)
code_block_8 = CodeBlock { false; }
clean_6 = List.Clean(list=create_3, preserveIndices=code_block_8)
flatten_8 = List.Flatten(list=clean_6)
VARNewElements = Output(flatten_8)
create_4 = List.Create(item0=filterByBoolMask.in, item1=filterByBoolMask_4.in)
code_block_9 = CodeBlock { false; }
clean_7 = List.Clean(list=create_4, preserveIndices=code_block_9)
flatten_9 = List.Flatten(list=clean_7)
count = List.Count(list=flatten_9)
VARNumberofMirroredElements = Output(count)
