# Dynamo custom node Model Line or Detail Line From (Model Line).dyf (Dynamo 2.1.0.7500)
# category: Synthesize.Automate.Lines
# Model Line or Detail Line From (Model Line)

VARDetailLine = Input(VARDetailLine: var[]..[] = FalseModelLine = True;)
code_block = CodeBlock { null; false; }
VARModelCurve = Input(VARModelCurve: var[]..[])
clean = List.Clean(list=VARModelCurve, preserveIndices=code_block.out1)
flatten = List.Flatten(list=clean)
scopeIf = Custom[CW.ScopeIf+](VARtest=VARDetailLine, VARtrue=code_block.out0, VARfalse=flatten)  # A (hopefully) more robust implementation of ScopeIf. Tests a single boolean and returns a value accordingly.
code_block_2 = CodeBlock { false; }
clean_2 = List.Clean(list=VARModelCurve, preserveIndices=code_block_2)
flatten_2 = List.Flatten(list=clean_2)
curves = Element.Curves(element=flatten_2)
scopeIf_2 = Custom[CW.ScopeIf+](VARtest=VARDetailLine, VARtrue=code_block.out0, VARfalse=curves)
clean_3 = List.Clean(list=scopeIf_2, preserveIndices=code_block.out1)
hot_get_revit_activeview = Custom[HOT.Get Revit ActiveView]()  # Active View
fromCurve = Custom[CW.DetailLine.FromCurve](VARcurve=clean_3, VARview=hot_get_revit_activeview)  # Creates a detail line based on a given curve
passthrough = Custom[CW.Passthrough](VARpassThrough=scopeIf, VARwaitFor=fromCurve)  # Forces a sequential order of execution. The node wired into the output of the Passthrough node will be executed *after* the node wired into the waitFor input (e.g. important for some Revit operations). The value of the passThrough input will be passed on to the node wired into the output port of the Passthrough node.
eraser = Custom[ST.Tool.Eraser](VARList=passthrough)  # Try to delete any element from project
VARCantdeleteIds = Output(eraser)
VARDetailLines = Output(fromCurve)
