# Dynamo custom node Odd or Even.dyf (Dynamo 2.1.0.7500)
# category: Synthesize.Math
# Odd or Even

VARInput = Input(VARInput: var[]..[])
python_script = Python(IN[0]=VARInput)
# ---------- python_script.python (17 lines) ----------
import clr
clr.AddReference('ProtoGeometry')
from Autodesk.DesignScript.Geometry import *
import math

#The inputs to this node will be stored as a list in the IN variables.

num = int(IN[0])
mod = num % 2
result = []
if mod > 0:
    result.append("odd")
else:
    result.append("even")

#Assign your output to the OUT variable.
OUT = result
# ----------------------------------------
VAROutput = Output(python_script)
