# Dynamo custom node Pads By Lists of Curves.dyf (Dynamo 2.1.0.7500)
# category: Synthesize.Automate.Topography
# Pads By Lists of Curves

element_types = ElementTypes("BuildingPad")
all_elements_of_type = ElementsOfType(element_type=element_types)
elementSketch = Custom[SP.Collector.ElementSketch](VARelement=all_elements_of_type)  # Get the actual sketch lines of a sketch based element (floor, ceiling, modified wall, etc.) . You can optionally fetch the matching model curves, however this might prove comptationally heavy on larger data sets.
code_block = CodeBlock { -0.01; }
curves_offset_to_revit = Custom[Curves Offset To Revit Compatibility](VARCurves=elementSketch.VARcurves@L3, VAROffset=code_block)  # Curves Offset To Revit Compatibility
byJoinedCurves = PolyCurve.ByJoinedCurves(curves=curves_offset_to_revit.VARCurves)
flatten = List.Flatten(list=byJoinedCurves)
byJoinedCurves_2 = PolyCurve.ByJoinedCurves(curves=elementSketch.VARcurves)
flatten_2 = List.Flatten(list=byJoinedCurves_2)
VARListsofCurves = Input(VARListsofCurves: var[]..[])
as_polycurve_bycurves = Custom[AS.[&] PolyCurve.ByCurves](VARcurves=VARListsofCurves)  # Create polycurves from an unordered list of curves.
boundingBox = Geometry.BoundingBox(geometry=as_polycurve_bycurves.VARpolyCurve)
minPoint = BoundingBox.MinPoint(boundingBox=boundingBox)
byOriginNormal = Plane.ByOriginNormal(origin=minPoint)
pullOntoPlane = Curve.PullOntoPlane(curve=as_polycurve_bycurves.VARpolyCurve, plane=byOriginNormal)
python_script = Python(IN[0]=flatten, IN[1]=flatten_2, IN[2]=pullOntoPlane)
# ---------- python_script.python (105 lines) ----------
# Enable Python support and load DesignScript library
# IMPORTANT : ALL DYNAMO DESIGN SCRIPT NODES ARE AS (dg)
import clr
clr.AddReference('ProtoGeometry')
from Autodesk.DesignScript import Geometry as dg

# EXTENSION Enable ToDSType
clr.AddReference('RevitNodes')
import Revit
clr.ImportExtensions(Revit.Elements)

# Enable Revit Elements
from Revit.Elements import *

# EXTENSION Enable Geometry Conversion Methods
clr.ImportExtensions(Revit.GeometryConversion)

# Enable Revit API
clr.AddReference('RevitAPI')
from Autodesk.Revit.DB import *

# Enable DocumentManager and TransactionManager
clr.AddReference('RevitServices')
from RevitServices.Persistence import DocumentManager
from RevitServices.Transactions import TransactionManager

# Enable ICollection List Translate
clr.AddReference("System")
import System.Collections.Generic
from System.Collections.Generic import List

dataEnteringNode = IN
# Use UnwrapElement(IN[0]) When Translating From Dynamo to Revit
existedloops=UnwrapElement(IN[0])
originalexisted=UnwrapElement(IN[1])
newloopsall=UnwrapElement(IN[2])

# Choose The Current Document
doc = DocumentManager.Instance.CurrentDBDocument
uidoc = DocumentManager.Instance.CurrentUIApplication.ActiveUIDocument
uiapp = DocumentManager.Instance.CurrentUIApplication
app = uiapp.Application

try:
	pulledexisted = []
	for e in existedloops:
		stp = e.StartPoint
		fromp = dg.CoordinateSystem.ByOrigin(stp)
		top = dg.CoordinateSystem.ByOrigin(stp.X,stp.Y,0)
		pulledexisted.append(dg.Geometry.Transform(e,fromp,top))

	pulledeoriginal = []
	for e in originalexisted:
		stp = e.StartPoint
		fromp = dg.CoordinateSystem.ByOrigin(stp)
		top = dg.CoordinateSystem.ByOrigin(stp.X,stp.Y,0)
		pulledeoriginal.append(dg.Geometry.Transform(e,fromp,top))

	bigresult = []
	for newloops in newloopsall:
		result = []
		for n in newloops:
			try:
				tmp = []
				stp = n.StartPoint
				fromp = dg.CoordinateSystem.ByOrigin(stp)
				top = dg.CoordinateSystem.ByOrigin(stp.X,stp.Y,0)
				n = dg.Geometry.Transform(n,fromp,top)
				counter = 0
				for e in pulledexisted:
					tothick = pulledeoriginal[counter]
					if dg.Geometry.DoesIntersect(n,e):
						extru = dg.Surface.ByPatch(tothick)	
						this = dg.Surface.Thicken(extru,1,True)
						tmp.append(this)
					counter += 1
				if len(tmp) != 0:
					nextru = dg.Surface.ByPatch(n)
					thisu = dg.Surface.Thicken(nextru,1,True)
					dif = dg.Solid.DifferenceAll(thisu,tmp)
					if dif.Volume == 0:
						continue
					tmpexp = dg.Geometry.Explode(dif)
					for e in tmpexp:
						tmpvec = dg.Surface.NormalAtParameter(e,0.5,0.5)
						if dg.Vector.IsAlmostEqualTo(tmpvec,dg.Vector.ZAxis().Reverse()):
							surf = e
					surf = dg.Geometry.Translate(surf,dg.Vector.ZAxis(),0.5)
					n = dg.Geometry.Transform(surf,top,fromp)
					n = dg.PolyCurve.ByJoinedCurves(n.PerimeterCurves())
					result.append(n)
					dif.Dispose()
					thisu.Dispose()
					nextru.Dispose()
				else:
					n = dg.Geometry.Transform(n,top,fromp)
					result.append(n)
			except:
				pass
		if len(result) != 0:
			bigresult.append(result)
	# Assign your output to the OUT variable.
	OUT = bigresult
except:
	OUT = newloopsall
# ----------------------------------------
explode = Geometry.Explode(geometry=python_script)
curves_offset_to_revit_2 = Custom[Curves Offset To Revit Compatibility](VARCurves=explode@L3)
VARBuildingPadType = Input(VARBuildingPadType: var[]..[])
building_pad_type_selector = Custom[Building Pad Type Selector](VARBuildingPadTypeName=VARBuildingPadType)  # Building Pad Type Selector
code_block_2 = CodeBlock { 1000; true; 0.001; 0; }
categories = Categories("OST_Levels")
all_elements_of_category = ElementsOfCategory(Category=categories)
firstItem = List.FirstItem(list=curves_offset_to_revit_2.VARCurves@L3)
firstItem_2 = List.FirstItem(list=firstItem@L2)
startPoint = Curve.StartPoint(curve=firstItem_2)
detect_levels_of_points = Custom[Detect Levels of Points](VARSetOffsetParameter=code_block_2.out1, VARRoundingValue=code_block_2.out2, VARRoundingFix=code_block_2.out1, VARFixFactorDependsofProjectUnits1Formetersforexampleand100forCentimeters=code_block_2.out0, VARLevels=all_elements_of_category, VARPoints=startPoint, VARZLocationOffset=code_block_2.out3)  # Detect Levels of Points From Family Refine Levels and Offset
python_script_2 = Python(IN[0]=curves_offset_to_revit_2.VARCurves, IN[1]=building_pad_type_selector, IN[2]=detect_levels_of_points.VARLevelsSet)
# ---------- python_script_2.python (73 lines) ----------
import clr
#Import Revit Services
clr.AddReference ("RevitServices")
import RevitServices
from RevitServices.Persistence import DocumentManager
from RevitServices.Transactions import TransactionManager
#Import Revit API
clr.AddReference('RevitAPI')
from Autodesk.Revit.DB import *
from Autodesk.Revit.DB.Architecture import *
clr.AddReference('RevitAPIUI')
from Autodesk.Revit.UI import *
#Import Revit Node
clr.AddReference('RevitNodes')
import Revit
clr.ImportExtensions(Revit.GeometryConversion)
clr.ImportExtensions(Revit.Elements)
#Import Proto Geometry
clr.AddReference('ProtoGeometry')
from Autodesk.DesignScript import Geometry as dg

import System
from System.Collections.Generic import *

def tolist(obj1):
	if hasattr(obj1,'__iter__'): return obj1
	else: return [obj1]
	
def flatten(x):
    result = []
    for el in x:
        if hasattr(el, "__iter__") and not isinstance(el, basestring):
            result.extend(flatten(el))
        else:
            result.append(el)
    return result
	
dataEnteringNode = IN
# Use UnwrapElement(IN[0]) When Translating From Dynamo to Revit
curves=UnwrapElement(IN[0])
typeId = UnwrapElement(IN[1]).Id
levels = UnwrapElement(IN[2])

# Choose The Current Document
doc = DocumentManager.Instance.CurrentDBDocument
uidoc = DocumentManager.Instance.CurrentUIApplication.ActiveUIDocument
uiapp = DocumentManager.Instance.CurrentUIApplication
app = uiapp.Application
	
# Create Empty List
result = []
result2 = []

TransactionManager.Instance.EnsureInTransaction(doc)
	
for r in curves:
	counter = 0
	try:
		dyntmp = []
		for each in r:
			tmp = CurveLoop()
			for e in each:
				tmp.Append(e.ToRevitType())
			dyntmp.append(tmp)
		result.append(BuildingPad.Create(doc,typeId,levels[counter].Id,dyntmp))
		counter += 1
	except:
		counter += 1
		result.append(None)
TransactionManager.Instance.TransactionTaskDone()

# Assign your output to the OUT variable
OUT = result
# ----------------------------------------
isNull = Object.IsNull(obj=python_script_2)
filterByBoolMask = List.FilterByBoolMask(list=python_script_2, mask=isNull)
code_block_3 = CodeBlock { "Height Offset From Level"; "Level"; }
filterByBoolMask_2 = List.FilterByBoolMask(list=detect_levels_of_points.VARElevationsSet, mask=isNull)
VARHeightOffset = Input(VARHeightOffset: var[]..[])
add = filterByBoolMask_2.out + VARHeightOffset
setParameterByName = Element.SetParameterByName(element=filterByBoolMask.out, parameterName=code_block_3.out0, value=add)
filterByBoolMask_3 = List.FilterByBoolMask(list=detect_levels_of_points.VARLevelsSet, mask=isNull)
setParameterByName_2 = Element.SetParameterByName(element=filterByBoolMask.out, parameterName=code_block_3.out1, value=filterByBoolMask_3.out)
VARPads = Output(filterByBoolMask.out)
VARPBuildingPadType = Output(building_pad_type_selector)
