# Dynamo custom node Paneled Divided Surface or Not.dyf (Dynamo 2.1.0.7500)
# category: Synthesize.Automate.DividedSurface
# Paneled Divided Surface or Not

VARDividedSurfaces = Input(VARDividedSurfaces: var[]..[])
python_script = Python(IN[0]=VARDividedSurfaces)
# ---------- python_script.python (51 lines) ----------
# Enable Python support and load DesignScript library
# IMPORTANT : ALL DYNAMO DESIGN SCRIPT NODES ARE AS (dg)
import clr
clr.AddReference('ProtoGeometry')
from Autodesk.DesignScript import Geometry as dg

# EXTENSION Enable ToDSType
clr.AddReference('RevitNodes')
import Revit
clr.ImportExtensions(Revit.Elements)

# Enable Revit Elements
from Revit.Elements import *

# EXTENSION Enable Geometry Conversion Methods
clr.ImportExtensions(Revit.GeometryConversion)

# Enable Revit API
clr.AddReference('RevitAPI')
from Autodesk.Revit.DB import *

# Enable DocumentManager and TransactionManager
clr.AddReference('RevitServices')
from RevitServices.Persistence import DocumentManager
from RevitServices.Transactions import TransactionManager

# Enable ICollection List Translate
clr.AddReference("System")
import System.Collections.Generic
from System.Collections.Generic import List

dataEnteringNode = IN
# Use UnwrapElement(IN[0]) When Translating From Dynamo to Revit
alldivsurf=UnwrapElement(IN[0])

# Choose The Current Document
doc = DocumentManager.Instance.CurrentDBDocument
uidoc = DocumentManager.Instance.CurrentUIApplication.ActiveUIDocument
uiapp = DocumentManager.Instance.CurrentUIApplication
app = uiapp.Application

status = []

for divsurf in alldivsurf:
	if doc.GetElement(divsurf.GetTypeId()).ToString() == "Autodesk.Revit.DB.TilePattern":
		status.append(False)
	else:
		status.append(True)

# Assign your output to the OUT variable.
OUT = status
# ----------------------------------------
VARBoolList = Output(python_script)
