# Dynamo custom node Parameter Copy.dyf (Dynamo 2.1.0.7500)
# category: Synthesize.Automate.Parameter
# Parameter Copy

VARElementsToMapTo = Input(VARElementsToMapTo: var[]..[])
VARElementsToCopyFrom = Input(VARElementsToCopyFrom: var[]..[])
VARCopyFromParameter = Input(VARCopyFromParameter: var[]..[])
getParameterValueByName = Element.GetParameterValueByName(element=VARElementsToCopyFrom, parameterName=VARCopyFromParameter, lacing=Longest)
code_block = CodeBlock { ""; }
eq = getParameterValueByName == code_block
filterByBoolMask = List.FilterByBoolMask(list=VARElementsToMapTo, mask=eq)
VARMapToParameter = Input(VARMapToParameter: var[]..[])
filterByBoolMask_2 = List.FilterByBoolMask(list=getParameterValueByName, mask=eq)
setParameterByName = Element.SetParameterByName(element=filterByBoolMask.out, parameterName=VARMapToParameter, value=filterByBoolMask_2.out, lacing=Longest)
VARElement = Output(setParameterByName)
