# Dynamo custom node Parts Level Auto Fix.dyf (Dynamo 2.1.0.7500)
# category: Synthesize.Automate.Parts
# Parts Level Auto Fix

code_block = CodeBlock { 1; }
VARFilteredParts = Input(VARFilteredParts: var[]..[] = FalseAllParts = True;)
categories = Categories("OST_Parts")
all_elements_of_category = ElementsOfCategory(Category=categories)
code_block_2 = CodeBlock { null; }
scopeIf = Custom[CW.ScopeIf+](VARtest=VARFilteredParts, VARtrue=all_elements_of_category, VARfalse=code_block_2)  # A (hopefully) more robust implementation of ScopeIf. Tests a single boolean and returns a value accordingly.
hot_get_all_filter = Custom[HOT.Get All Filter]()  # Get all Filter
VARPartsfiltertoread = Input(VARPartsfiltertoread: var[]..[])
eq = hot_get_all_filter.VARName == VARPartsfiltertoread
filterByBoolMask = List.FilterByBoolMask(list=hot_get_all_filter.VARElement, mask=eq)
elements = Custom[CW.SelectionSet.Elements](VARselectionSet=filterByBoolMask.in)  # Retrieves all elements stored in a selection set
scopeIf_2 = Custom[CW.ScopeIf+](VARtest=VARFilteredParts, VARtrue=code_block_2, VARfalse=elements)
join = List.Join(list0=scopeIf, list1=scopeIf_2)
code_block_3 = CodeBlock { false; }
clean = List.Clean(list=join, preserveIndices=code_block_3)
flatten = List.Flatten(list=clean)
code_block_4 = CodeBlock { "Original Category"; }
getParameterValueByName = Element.GetParameterValueByName(element=flatten, parameterName=code_block_4)
code_block_5 = CodeBlock { "Floors"; "Roofs"; }
eq_2 = getParameterValueByName == code_block_5.out0
filterByBoolMask_2 = List.FilterByBoolMask(list=flatten, mask=eq_2)
getParameterValueByName_2 = Element.GetParameterValueByName(element=filterByBoolMask_2.out, parameterName=code_block_4)
eq_3 = getParameterValueByName_2 == code_block_5.out1
filterByBoolMask_3 = List.FilterByBoolMask(list=filterByBoolMask_2.out, mask=eq_3)
join_2 = List.Join(list0=filterByBoolMask_3.in, list1=filterByBoolMask_2.in)
uniqueItems = List.UniqueItems(list=join_2)
code_block_6 = CodeBlock { "Base Level"; }
element_types = ElementTypes("Level")
all_elements_of_type = ElementsOfType(element_type=element_types)
boundingBox = Element.BoundingBox(element=uniqueItems)
count = List.Count(list=boundingBox)
cycle = List.Cycle(list=all_elements_of_type, amount=count)
count_2 = List.Count(list=all_elements_of_type)
chop = List.Chop(list=cycle, lengths=count_2)
code_block_7 = CodeBlock { 1; }
chop_2 = List.Chop(list=all_elements_of_type, lengths=code_block_7)
plane = Custom[CW.Level.Plane](VARlevel=chop_2)  # Retrieves the plane of a given level
boundingBox_2 = Geometry.BoundingBox(geometry=plane)
flatten_2 = List.Flatten(list=boundingBox_2)
minPoint = BoundingBox.MinPoint(boundingBox=flatten_2)
maxPoint = BoundingBox.MaxPoint(boundingBox=flatten_2)
X = Point.X(point=maxPoint)
VARFixFactorDependsofProjectUnits1Formet = Input(VARFixFactorDependsofProjectUnits1Formetersforexampleand100forCentimeters: var[]..[])
mul = X * VARFixFactorDependsofProjectUnits1Formet
Y = Point.Y(point=maxPoint)
mul_2 = Y * VARFixFactorDependsofProjectUnits1Formet
elevation = Level.Elevation(level=all_elements_of_type)
code_block_8 = CodeBlock { -1; }
shiftIndices = List.ShiftIndices(list=elevation, amount=code_block_8)
getKeys = GetKeys(list=shiftIndices)
lastItem = List.LastItem(list=getKeys)
maximumItem = List.MaximumItem(list=shiftIndices)
code_block_9 = CodeBlock { 2; }
mul_3 = maximumItem * code_block_9
replaceItemAtIndex = List.ReplaceItemAtIndex(list=shiftIndices, index=lastItem, item=mul_3)
dm_fix_point_bycoordinates_range = Custom[DM.Fix Point.ByCoordinates Range](VARx=mul, VARy=mul_2, VARz=replaceItemAtIndex)  # Dummy Node to fix the modelling range warning
byCorners = BoundingBox.ByCorners(min=minPoint, max=dm_fix_point_bycoordinates_range)
maxPoint_2 = BoundingBox.MaxPoint(boundingBox=boundingBox)
X_2 = Point.X(point=maxPoint_2)
Y_2 = Point.Y(point=maxPoint_2)
Z = Point.Z(point=maxPoint_2)
VARMaximumFloorsThicknessusedinProject = Input(VARMaximumFloorsThicknessusedinProject: var[]..[])
add = Z + VARMaximumFloorsThicknessusedinProject
byCoordinates = Point.ByCoordinates(x=X_2, y=Y_2, z=add)
minPoint_2 = BoundingBox.MinPoint(boundingBox=boundingBox)
X_3 = Point.X(point=minPoint_2)
Y_3 = Point.Y(point=minPoint_2)
Z_2 = Point.Z(point=minPoint_2)
add_2 = Z_2 + VARMaximumFloorsThicknessusedinProject
byCoordinates_2 = Point.ByCoordinates(x=X_3, y=Y_3, z=add_2)
byStartPointEndPoint = Line.ByStartPointEndPoint(startPoint=byCoordinates, endPoint=byCoordinates_2)
code_block_10 = CodeBlock { 0.5; }
pointAtParameter = Curve.PointAtParameter(curve=byStartPointEndPoint, param=code_block_10)
contains = BoundingBox.Contains(boundingBox=byCorners, point=pointAtParameter@L1)
filterByBoolMask_4 = List.FilterByBoolMask(list=chop, mask=contains)
setParameterByName = Element.SetParameterByName(element=uniqueItems, parameterName=code_block_6, value=filterByBoolMask_4.in)
uniqueItems_2 = List.UniqueItems(list=filterByBoolMask_3.out)
code_block_11 = CodeBlock { "Base Level"; }
element_types_2 = ElementTypes("Level")
all_elements_of_type_2 = ElementsOfType(element_type=element_types_2)
code_block_12 = CodeBlock { "Elevation"; }
getParameterValueByName_3 = Element.GetParameterValueByName(parameterName=code_block_12)  # unwired: element
sortByFunction = List.SortByFunction(list=all_elements_of_type_2, func=getParameterValueByName_3)
boundingBox_3 = Element.BoundingBox(element=uniqueItems_2)
count_3 = List.Count(list=boundingBox_3)
cycle_2 = List.Cycle(list=sortByFunction, amount=count_3)
count_4 = List.Count(list=sortByFunction)
chop_3 = List.Chop(list=cycle_2, lengths=count_4)
code_block_13 = CodeBlock { 1; }
chop_4 = List.Chop(list=sortByFunction, lengths=code_block_13)
plane_2 = Custom[CW.Level.Plane](VARlevel=chop_4)
boundingBox_4 = Geometry.BoundingBox(geometry=plane_2)
flatten_3 = List.Flatten(list=boundingBox_4)
minPoint_3 = BoundingBox.MinPoint(boundingBox=flatten_3)
maxPoint_3 = BoundingBox.MaxPoint(boundingBox=flatten_3)
X_4 = Point.X(point=maxPoint_3)
mul_4 = X_4 * VARFixFactorDependsofProjectUnits1Formet
Y_4 = Point.Y(point=maxPoint_3)
mul_5 = Y_4 * VARFixFactorDependsofProjectUnits1Formet
elevation_2 = Level.Elevation(level=sortByFunction)
code_block_14 = CodeBlock { -1; }
shiftIndices_2 = List.ShiftIndices(list=elevation_2, amount=code_block_14)
getKeys_2 = GetKeys(list=shiftIndices_2)
lastItem_2 = List.LastItem(list=getKeys_2)
maximumItem_2 = List.MaximumItem(list=shiftIndices_2)
code_block_15 = CodeBlock { 2; }
mul_6 = maximumItem_2 * code_block_15
replaceItemAtIndex_2 = List.ReplaceItemAtIndex(list=shiftIndices_2, index=lastItem_2, item=mul_6)
dm_fix_point_bycoordinates_range_2 = Custom[DM.Fix Point.ByCoordinates Range](VARx=mul_4, VARy=mul_5, VARz=replaceItemAtIndex_2)
byCorners_2 = BoundingBox.ByCorners(min=minPoint_3, max=dm_fix_point_bycoordinates_range_2)
minPoint_4 = BoundingBox.MinPoint(boundingBox=boundingBox_3)
maxPoint_4 = BoundingBox.MaxPoint(boundingBox=boundingBox_3)
byStartPointEndPoint_2 = Line.ByStartPointEndPoint(startPoint=minPoint_4, endPoint=maxPoint_4)
code_block_16 = CodeBlock { 0.5; }
pointAtParameter_2 = Curve.PointAtParameter(curve=byStartPointEndPoint_2, param=code_block_16)
contains_2 = BoundingBox.Contains(boundingBox=byCorners_2, point=pointAtParameter_2@L1)
filterByBoolMask_5 = List.FilterByBoolMask(list=chop_3, mask=contains_2)
setParameterByName_2 = Element.SetParameterByName(element=uniqueItems_2, parameterName=code_block_11, value=filterByBoolMask_5.in)
create = List.Create(item0=setParameterByName, item1=setParameterByName_2)
code_block_17 = CodeBlock { false; }
clean_2 = List.Clean(list=create, preserveIndices=code_block_17)
flatten_4 = List.Flatten(list=clean_2)
VARParts = Output(flatten_4)
