# Dynamo custom node Patterns Voider Generator.dyf (Dynamo 2.1.0.7500)
# category: Synthesize.Automate.Adaptive
# Patterns Voider Generator

VARFullFace = Input(VARFullFace: var[]..[])
VARSurfaces = Input(VARSurfaces: var[]..[])
surface_importer = Custom[Surface Importer](VARSurfaces=VARSurfaces)  # Surface Importer Node
surfaces = PolySurface.Surfaces(polySurface=surface_importer)
flatten = List.Flatten(list=surfaces)
perimeterCurves = Surface.PerimeterCurves(surface=flatten)
isNull = Object.IsNull(obj=perimeterCurves)
anyTrue = Custom[CW.List.AnyTrue](VARseq=isNull)  # Returns true if any item in a list of booleans is true.
filterByBoolMask = List.FilterByBoolMask(list=flatten, mask=anyTrue)
perimeter = Surface.Perimeter(surface=filterByBoolMask.out)
VARFaceExtendRatio0To1 = Input(VARFaceExtendRatio0To1: var[]..[])
mul = perimeter * VARFaceExtendRatio0To1
code_block = CodeBlock { 5; }
lt = _ < code_block  # unwired: x
replaceByCondition = Replace(item=mul, replaceWith=code_block, condition=lt)
sequence = Sequence(amount=replaceByCondition, lacing=Longest)
code_block_2 = CodeBlock { 0.5; 1; }
byIsoCurveOnSurface = Curve.ByIsoCurveOnSurface(baseSurface=filterByBoolMask.out@L1, parameter=code_block_2.out0)
length = Curve.Length(curve=byIsoCurveOnSurface)
byIsoCurveOnSurface_2 = Curve.ByIsoCurveOnSurface(baseSurface=filterByBoolMask.out@L1, direction=code_block_2.out1, parameter=code_block_2.out0)
length_2 = Curve.Length(curve=byIsoCurveOnSurface_2)
div = length / length_2
code_block_3 = CodeBlock { 2; }
mul_2 = div * code_block_3
code_block_4 = CodeBlock(a=VARFaceExtendRatio0To1, x=mul_2) { 0-a/x; a/x+1; }
remapRange = Math.RemapRange(numbers=sequence, newMin=code_block_4.out0, newMax=code_block_4.out1)
code_block_5 = CodeBlock(b=VARFaceExtendRatio0To1, a=VARFaceExtendRatio0To1) { 0-b; a+1; }
remapRange_2 = Math.RemapRange(numbers=sequence, newMin=code_block_5.out0, newMax=code_block_5.out1)
byCoordinates = UV.ByCoordinates(u=remapRange, v=remapRange_2)
U = UV.U(uV=byCoordinates)
V = UV.V(uV=byCoordinates)
python_script = Python(IN[0]=filterByBoolMask.out, IN[1]=U, IN[2]=V)
# ---------- python_script.python (61 lines) ----------
# Created By Karam Baki : karam@aecedx.com
# Enable Python support and load DesignScript library
# IMPORTANT : ALL DYNAMO DESIGN SCRIPT NODES ARE AS (dg)
import clr
clr.AddReference('ProtoGeometry')
from Autodesk.DesignScript import Geometry as dg

# EXTENSION Enable ToDSType
clr.AddReference('RevitNodes')
import Revit
clr.ImportExtensions(Revit.Elements)

# Enable Revit Elements
from Revit.Elements import *

# EXTENSION Enable Geometry Conversion Methods
clr.ImportExtensions(Revit.GeometryConversion)

# Enable Revit API
clr.AddReference('RevitAPI')
from Autodesk.Revit.DB import *

# Enable DocumentManager and TransactionManager
clr.AddReference('RevitServices')
from RevitServices.Persistence import DocumentManager
from RevitServices.Transactions import TransactionManager

# Enable ICollection List Translate
clr.AddReference("System")
import System.Collections.Generic
from System.Collections.Generic import List

dataEnteringNode = IN
# Use UnwrapElement(IN[0]) When Translating From Dynamo to Revit
surfs=UnwrapElement(IN[0])
ulists=UnwrapElement(IN[1])
vlists=UnwrapElement(IN[2])

# Choose The Current Document
doc = DocumentManager.Instance.CurrentDBDocument
uidoc = DocumentManager.Instance.CurrentUIApplication.ActiveUIDocument
uiapp = DocumentManager.Instance.CurrentUIApplication
app = uiapp.Application

# Create Empty List
result = []

count = 0
for each in surfs:
	innercount = 0
	tmp = []
	for e in ulists[count]:
		tmp2 = []
		for k in vlists[count]:
			tmp2.append(dg.Surface.PointAtParameter(each,e,k))
		tmp.append(tmp2)
	result.append(tmp)
	count = count + 1

# Assign your output to the OUT variable.
OUT = result
# ----------------------------------------
byPoints = NurbsSurface.ByPoints(points=python_script)
empty = List.Empty()
scopeIf = Custom[CW.ScopeIf+](VARtest=VARFullFace, VARtrue=empty, VARfalse=flatten)  # A (hopefully) more robust implementation of ScopeIf. Tests a single boolean and returns a value accordingly.
join_adjacent_surfaces = Custom[Join Adjacent Surfaces](VARSurfaces=scopeIf)  # Join Adjacent Surfaces
VARThickness = Input(VARThickness: double)
VARThickenBothSides = Input(VARThickenBothSides: var[]..[])
thicken = Surface.Thicken(surface=join_adjacent_surfaces, thickness=VARThickness, both_sides=VARThickenBothSides)
python_script_2 = Python(IN[0]=thicken, IN[1]=byPoints)
# ---------- python_script_2.python (52 lines) ----------
# Enable Python support and load DesignScript library
# IMPORTANT : ALL DYNAMO DESIGN SCRIPT NODES ARE AS (dg)
import clr
clr.AddReference('ProtoGeometry')
from Autodesk.DesignScript import Geometry as dg

# EXTENSION Enable ToDSType
clr.AddReference('RevitNodes')
import Revit
clr.ImportExtensions(Revit.Elements)

# Enable Revit Elements
from Revit.Elements import *

# EXTENSION Enable Geometry Conversion Methods
clr.ImportExtensions(Revit.GeometryConversion)

# Enable Revit API
clr.AddReference('RevitAPI')
from Autodesk.Revit.DB import *

# Enable DocumentManager and TransactionManager
clr.AddReference('RevitServices')
from RevitServices.Persistence import DocumentManager
from RevitServices.Transactions import TransactionManager

# Enable ICollection List Translate
clr.AddReference("System")
import System.Collections.Generic
from System.Collections.Generic import List

dataEnteringNode = IN
# Use UnwrapElement(IN[0]) When Translating From Dynamo to Revit
solids=UnwrapElement(IN[0])
surfs=UnwrapElement(IN[1])

# Choose The Current Document
doc = DocumentManager.Instance.CurrentDBDocument
uidoc = DocumentManager.Instance.CurrentUIApplication.ActiveUIDocument
uiapp = DocumentManager.Instance.CurrentUIApplication
app = uiapp.Application

groups = []
for sol in solids:
	tmp = []
	for surf in surfs:
		if dg.Geometry.DoesIntersect(sol,surf):
			tmp.append(surf)
	groups.append(tmp)

# Assign your output to the OUT variable.
OUT = groups
# ----------------------------------------
subtractFrom = Surface.SubtractFrom(surface=python_script_2, trimmingEntity=thicken)
scopeIf_2 = Custom[CW.ScopeIf+](VARtest=VARFullFace, VARtrue=byPoints, VARfalse=subtractFrom)
flatten_2 = List.Flatten(list=scopeIf_2)
explode = Geometry.Explode(geometry=flatten_2)
thicken_2 = Surface.Thicken(surface=explode, thickness=VARThickness, both_sides=VARThickenBothSides)
byUnion = Custom[CW.Solid.ByUnion+](VARsolids=thicken_2)  # The OOTB node Solid.ByUnion occasionally fails when trying to merge solids with almost adjacent faces. This node will return the minimum amount of joined solids possible in such cases instead of returning null.
flatten_3 = List.Flatten(list=byUnion)
VARSolid = Output(flatten_3)
