# Dynamo custom node Place Family By Room Center.dyf (Dynamo 2.1.0.7500)
# category: Synthesize.Automate.Family
# Place Family By Room Center

VARFamilyType = Input(VARFamilyType: var[]..[])
VARAllRooms = Input(VARAllRooms: var[]..[])
code_block = CodeBlock { true; }
lb_lunchbox_room_element = Custom[LB.LunchBox Room Element Collector](VARToggle=code_block)  # Collects rooms from the Revit document
VARYesNoSyncParameter = Input(VARYesNoSyncParameter: var[]..[])
getParameterValueByName = Element.GetParameterValueByName(element=lb_lunchbox_room_element.VARElement, parameterName=VARYesNoSyncParameter)
code_block_2 = CodeBlock { 1; }
eq = getParameterValueByName == code_block_2
filterByBoolMask = List.FilterByBoolMask(list=lb_lunchbox_room_element.VARElement, mask=eq)
scopeIf = Custom[CW.ScopeIf+](VARtest=VARAllRooms, VARtrue=lb_lunchbox_room_element.VARElement, VARfalse=filterByBoolMask.in)  # A (hopefully) more robust implementation of ScopeIf. Tests a single boolean and returns a value accordingly.
location_of_any_element = Custom[Location Of Any Element](VARElements=scopeIf)  # Location Of Any Element
byPoint = FamilyInstance.ByPoint(familyType=VARFamilyType, point=location_of_any_element.VARLocations)
end = Revit.Transaction.Transaction.End(input=byPoint)
setLocation = Element.SetLocation(element=end, geometry=location_of_any_element.VARLocations)
code_block_3 = CodeBlock { false; }
clean = List.Clean(list=byPoint, preserveIndices=code_block_3)
flatten = List.Flatten(list=clean)
VARFamilyInstances = Output(flatten)
