# Dynamo custom node Place Family By Surfaces.dyf (Dynamo 2.1.0.7500)
# category: Synthesize.Automate.Family
# Place Family By Room

VARSurfaces = Input(VARSurfaces: var[]..[])
VARTrimmedSurfaces = Input(VARTrimmedSurfaces: var[]..[])
VARFamilyType = Input(VARFamilyType: var[]..[])
VARUdistance = Input(VARUdistance: var[]..[])
VARVdistance = Input(VARVdistance: var[]..[])
VARTryRhomboid = Input(VARTryRhomboid: var[]..[])
VARTrimOffset = Input(VARTrimOffset: var[]..[])
VARUpperMode = Input(VARUpperMode: var[]..[])
VARMidModeHeight = Input(VARMidModeHeight: var[]..[])
VARCreateSelectionFilter = Input(VARCreateSelectionFilter: var[]..[])
VARSelectionFilterName = Input(VARSelectionFilterName: var[]..[])
python_script = Python(IN[0]=VARSurfaces, IN[1]=VARTrimmedSurfaces, IN[2]=VARFamilyType, IN[3]=VARUdistance, IN[4]=VARVdistance, IN[5]=VARTryRhomboid, IN[6]=VARTrimOffset, IN[7]=VARUpperMode, IN[8]=VARMidModeHeight, IN[9]=VARCreateSelectionFilter, IN[10]=VARSelectionFilterName)
# ---------- python_script.python (1135 lines) ----------
# Enable Python support and load DesignScript library
# IMPORTANT : ALL DYNAMO DESIGN SCRIPT NODES ARE AS (dg)
import clr
clr.AddReference('ProtoGeometry')
from Autodesk.DesignScript import Geometry as dg

# EXTENSION Enable ToDSType
clr.AddReference('RevitNodes')
import Revit
clr.ImportExtensions(Revit.Elements)

# Enable Revit Elements
from Revit.Elements import *

# EXTENSION Enable Geometry Conversion Methods
clr.ImportExtensions(Revit.GeometryConversion)

# Enable Revit API
clr.AddReference('RevitAPI')
from Autodesk.Revit.DB import *

# Enable DocumentManager and TransactionManager
clr.AddReference('RevitServices')
from RevitServices.Persistence import DocumentManager
from RevitServices.Transactions import TransactionManager

# Enable ICollection List Translate
clr.AddReference("System")
import System.Collections.Generic
from System.Collections.Generic import List

import math
import random
import string

class WarnSwallowSimple(IFailuresPreprocessor):
	def PreprocessFailures(self, failuresAccessor):
		failuresAccessor.DeleteAllWarnings()
		return FailureProcessingResult.Continue

def flatten(x):
    result = []
    for el in x:
        if hasattr(el, "__iter__") and not isinstance(el, basestring):
            result.extend(flatten(el))
        else:
            result.append(el)
    return result

def tolist(obj1):
	if hasattr(obj1,'__iter__'): return obj1
	else: return [obj1]

def isplanarsurf(s):
	norms = [0,0.333,0.666,1]
	pts = []
	for n in norms:
		for n2 in norms:
			pts.append(dg.Surface.PointAtParameter(s,n,n2))
	plane = dg.Plane.ByBestFitThroughPoints(pts)
	status = True
	for p in pts:
		try:
			inter = dg.Geometry.DoesIntersect(p,plane)
			if inter == False:
				status = False
				break
		except:
			pass
	return status

def iscurvesurf(s):
	norms = [0,0.333,0.666,1]
	try:
		for n in norms:
			curve1 = dg.Geometry.Explode(dg.Curve.ByIsoCurveOnSurface(s,0,n))[0]
			curve2 = dg.Geometry.Explode(dg.Curve.ByIsoCurveOnSurface(s,1,n))[0]
			if (isinstance(curve1, dg.Line) or isinstance(curve1, dg.Circle)) and (isinstance(curve2, dg.Line) or isinstance(curve2, dg.Circle)):
				continue
			else:
				isgood = False
				try:
					arclength1 = dg.Arc.ByThreePoints(curve1.StartPoint,dg.Curve.PointAtParameter(curve1,0.5),curve1.EndPoint).Length
					if round(arclength1,2) == round(curve1.Length):
						continue
					else:
						return False
				except:	
					isgood = True
					pass
				try:
					arclength2 = dg.Arc.ByThreePoints(curve2.StartPoint,dg.Curve.PointAtParameter(curve2,0.5),curve2.EndPoint).Length
					if round(arclength2,2) == round(curve2.Length):
						continue
					else:
						return False
				except:
					isgood = True
					pass
				if isgood:
					continue
		return True
	except:
		return False

def getbestold(fixedexploded,bord,solid):
	tmpareas = []
	for x in fixedexploded:
		tmpareas.append(x.Area)
	status = "Again"
	while status == "Again":
		maxarea = max(tmpareas)
		innercount = 0
		for r in tmpareas:
			if maxarea == r:
				point_onsurf = dg.Surface.PointAtParameter(fixedexploded[innercount])
				vec_onsurf = dg.Surface.NormalAtParameter(fixedexploded[innercount])
				transformed = dg.Geometry.Translate(point_onsurf,vec_onsurf,bord/1.5)
				if dg.Geometry.DoesIntersect(transformed,solid):
					fixedexploded.pop(innercount)
					tmpareas.pop(innercount)
					status = "Again"
					break
				else:
					surfi = fixedexploded.pop(innercount)
					wanted1 = dg.Surface.Thicken(surfi,borw*-1,False)
					surfi.Dispose()
					tmpareas.pop(innercount)
					status = "Stop"
					break
			innercount += 1
	return wanted1,fixedexploded

def framesv2(surfs,bord,borw):
	thickned = []
	wantedwitdh = borw  * 2
	wanteddepth = wantedwitdh + bord
	thickned = dg.Surface.Thicken(surfs,wanteddepth,True)
	count = 0
	thinedshell = dg.Solid.ThinShell(thickned,borw,0)
	exploded = dg.Geometry.Explode(thinedshell)
	fixedexploded = []
	for x in exploded:
		fixedexploded.append(x)
	wanted = getbestold(fixedexploded,bord,thickned)
	wanted1 = wanted[0]
	wanted2 = getbestold(wanted[1],bord,thickned)[0]
	allwants = [wanted1,wanted2]
	finalresult = dg.Solid.DifferenceAll(thinedshell,allwants)
	thickned.Dispose()
	thinedshell.Dispose()
	for x in fixedexploded:
		x.Dispose()
	return finalresult

def framesv1(surfs,bord,borw):
	frames = []
	thicken = dg.Surface.Thicken(surfs,bord)
	exploded = dg.Geometry.Explode(thicken)[2:]
	joined = joinsurfs(exploded)
	prejointhicken = []
	for j in joined:
		prejointhicken.append(dg.Surface.Thicken(j,-borw,False))
	unioned = dg.Solid.ByUnion(prejointhicken)
	for x in exploded:
		x.Dispose()
	for j in joined:
		j.Dispose()
	thicken.Dispose()
	for j in prejointhicken:
		j.Dispose()
	return unioned

def framesv3(surfs,bord,borw):
	frames = []
	try:
		thicken = dg.Surface.Thicken(surfs,bord)
	except:
		permpan = dg.PolyCurve.ByJoinedCurves(surfs.PerimeterCurves())
		patchedpan = dg.Surface.ByPatch(permpan)
		thicken = dg.Surface.Thicken(patchedpan,bord,True)
		permpan.Dispose()
	exploded = dg.Geometry.Explode(thicken)[2:]
	thickenex = []
	for x in exploded:
		try:
			thickenex.append(dg.Surface.Thicken(x,borw*2,True))	
		except:
			pass
	s = patchedpan
	for int in thickenex:
		s = dg.Surface.SubtractFrom(s,int)[0]
	slisted = [s]
	inverse = dg.Surface.Difference(patchedpan,slisted)
	return inverse,thickenex

def joinsurfs(surfs):
	def surf_doesinter(a,b,tollerance = 0.00001):
		if round(dg.Geometry.DistanceTo(a,b),2) < tollerance:
			return True
		else:
			return False
	surfacesflatten = flatten(surfs)
	surfacesflatten = [x for x in surfacesflatten if x]
	if surfacesflatten != None and surfacesflatten != []:
		crvs = flatten(tolist(surfs))
		crvGroup = [-1 for x in range(len(crvs))]
		crvGroup[0] = 0
		maxGroupNum = 1
		for i in range(len(crvs)):
			if (crvGroup[i] == -1):
				crvGroup[i] = i
			for j in range(len(crvs)):
				try:
					if i != j and surf_doesinter(crvs[i], crvs[j]):
						if (crvGroup[j] == -1):
							crvGroup[j] = crvGroup[i]
						elif (crvGroup[i] != crvGroup[j]):
							oldNum = crvGroup[j]
							for k in range(len(crvs)):
								if (crvGroup[k] == oldNum):
									crvGroup[k] = crvGroup[i]
				except:
					pass
		groups = []
		excluded = []
		for n in crvGroup:
			innercount = 0
			tmp = []
			for n2 in crvGroup:
				if n == n2 and n2 not in excluded:
					tmp.append(crvs[innercount])
				innercount += 1
			if len(tmp) == 0:
				continue
			try:
				tmp = dg.Surface.ByUnion(tmp)
				groups.append(tmp)
			except:
				try:
					tmp = dg.PolySurface.ByJoinedSurfaces(tmp)
					groups.append(tmp)
				except:
					for t in tmp:
						groups.append(t)
			excluded.append(n)
		joinedsurfs = groups
		return joinedsurfs
	else:
		return surfs

def flatten(x):
    result = []
    for el in x:
        if hasattr(el, "__iter__") and not isinstance(el, basestring):
            result.extend(flatten(el))
        else:
            result.append(el)
    return result

def surfacesubtract(surf,solids,isplanar=None):
	solids = tolist(solids)
	if isplanar != None:
		isplanar = tolist(isplanar)
		if all(isplanar) == True:
			try:
				tryunion = dg.Solid.ByUnion(solids)
				solids = [tryunion]
			except:
				pass
	result = []
	s = surf
	s = trysoliddif(s,solids)
	try:
		slistedexplode = dg.Geometry.Explode(s)
		inverse = dg.Surface.Difference(surf,slistedexplode)
	except:
		sfixed = []
		exploded = slistedexplode
		areas = []
		for i in exploded:
			areas.append(i.Area)
		maxarea = max(areas)
		counter = 0
		for a in areas:
			if maxarea == a:
				wantedsurf = exploded[counter]
				break
			counter += 1
		sfixed.append(wantedsurf)
		try:
			inverse = dg.Surface.Difference(surf,sfixed)
		except:
			inverse = None
	try:
		explodedS = dg.Geometry.Explode(s)
		areasS = []
		for i in explodedS:
			areasS.append(i.Area)
		maxarea = max(areasS)
		counter = 0
		for a in areasS:
			if maxarea == a:
				s = explodedS[counter]
				break
			counter += 1
	except:
		pass
	return s,inverse

def operateframes(surfs,bord,borw):
	subtractedlist = []
	inversedlist = []
	for s in surfs:
		try:
			already = False
			danger = False
			try:
				solidframe = framesv1(s,bord,borw)
			except:
				solidframe = framesv2(s,bord,borw)
				danger = True
			if solidframe == None and danger == False:
				solidframe = framesv2(s,bord,borw)
				already = True
			subtract = surfacesubtract(s,solidframe)
			subtracted = subtract[0]
			inversed = subtract[1]
			subtractedlist.append(subtracted)
			inversedlist.append(inversed)
		except:
			try:
				if already == False:
					solidframe = framesv2(s,bord,borw)
					subtract = surfacesubtract(s,solidframe)
					subtracted = subtract[0]
					inversed = subtract[1]
					subtractedlist.append(subtracted)
					inversedlist.append(inversed)
				else:
					subtractedlist.append(s)
					inversedlist.append(None)
			except:
				try:
					solidframe = framesv3(s,bord,borw)
					sf = s
					for int in solidframe[1]:
						try:
							testifwork = dg.Surface.SubtractFrom(sf,int)
							if len(testifwork) != 0:
								sf = testifwork[0]
						except:
							pass
					subtractedlist.append(sf)
					inversedlist.append(solidframe[0])
				except:
					subtractedlist.append(s)
					inversedlist.append(None)
		try:
			solidframe.Dispose()
		except:
			pass
	return subtractedlist,inversedlist

def trythicken(poly,thickness,offset = 0):
	offsetpoly = tryoffset(poly,offset)
	try:
		solid = dg.Surface.Thicken(offsetpoly,thickness,True)
	except:
		solids = []
		extracted = dg.Geometry.Explode(poly)
		for e in extracted:
			e = tryoffset(e,offset)
			try:
				solids.append(dg.Surface.Thicken(e,thickness,True))
			except:
				try:
					permpan = dg.PolyCurve.ByJoinedCurves(e.PerimeterCurves())
					patchedpan = dg.Surface.ByPatch(permpan)
					solids.append(dg.Surface.Thicken(patchedpan,thickness,True))
					permpan.Dispose()
					patchedpan.Dispose()
				except:
					pass
		try:
			solid = dg.Solid.ByUnion(solids)
			for s in solids:
				s.Dispose()
		except:
			solid = solids
	return solid

def trysoliddif(surf,solidsstovoid):
	s = surf
	failed = []
	for int in solidsstovoid:
		try:
			testifwork = dg.Surface.SubtractFrom(s,int)
			if len(testifwork) != 0:
				s = testifwork[0]
			else:
				failed.append(int)
		except:
			failed.append(int)
	if len(failed) != 0:
		resfail = []
		for f in failed:
			resfail.append(dg.Geometry.Intersect(surf,f))
		resfail = flatten(resfail)
		try:
			for sone in resfail:
				s = dg.Surface.Difference(s,[sone])
		except:
			pass
	return s

def tryoffset(surf,offset):
	try:
		if offset != 0:
			surf = dg.Surface.Offset(surf,offset)
	except:
		pass
	return surf

def tryunion(flattenedsolids):
	if len(flattenedsolids) > 1:
		solids = [x for x in flattenedsolids if x]
		if len(solids) > 1:
			pass
		else:
			return flattenedsolids
		unioned = [solids[0]]
		solids = solids[1:]
		for s in solids:
			i = 0
			unionDone = False
			while i < len(unioned):
				try:
					unioned[i] = unioned[i].Union(s)
					unionDone = True
					break
				except:	i += 1
			if not unionDone: unioned.append(s)
		try:
			for f in flattenedsolids:
				f.Dispose()
		except:
			pass
		return unioned
	else:
		return flattenedsolids

def get_unique_numbers(numbers):
    list_of_unique_numbers = []
    unique_numbers = set(numbers)
    for number in unique_numbers:
        list_of_unique_numbers.append(number)
    return list_of_unique_numbers
    
def PROgetgeom(doc,geom,originalnotjoinedgeom = False,includehiddengeom = False):
	def on_dialog_open(sender, event):
	    try:
	        if event.DialogId == 'TaskDialog_Really_Print_Or_Export_Temp_View_Modes':
	            event.OverrideResult(1002) 
	    except Exception as e:
	        pass

	def cleangeomlist(geoms):
		filteredgeoms = []
		for e in geoms:
			if isinstance(e,str) or isinstance(e,dg.Solid) or isinstance(e,dg.Surface) or isinstance(e,dg.PolySurface) or isinstance(e,dg.Cuboid):
				filteredgeoms.append(e)
		return filteredgeoms
	
	# Better SAT Import Function
	def betteimport(doc,sat,temp_path):
		geoms = dg.Geometry.ImportFromSAT(sat)
		sat_path = None
		try:
			if int(DocumentManager.Instance.CurrentUIApplication.Application.VersionNumber) < 2021:
				factor = round(UnitUtils.ConvertFromInternalUnits(3.280839895,doc.GetUnits().GetFormatOptions(UnitType.UT_Length).DisplayUnits),8) * 1000
			else:
				factor = round(UnitUtils.ConvertFromInternalUnits(3.280839895,doc.GetUnits().GetFormatOptions(SpecTypeId.Length).GetUnitTypeId()),8) * 1000
			randomname = ''.join([random.choice(string.ascii_letters + string.digits) for n in xrange(5)])
			sat_path = '%s%s.sat' % (temp_path, randomname)
			dg.Geometry.ExportToSAT(geoms,sat_path,factor)
			for g in geoms:
				g.Dispose()
			scaledgeoms = dg.Geometry.ImportFromSAT(sat_path)
		except:
			scaledgeoms = geoms
		if sat_path != None:
			System.IO.File.Delete(sat_path)
		return scaledgeoms
	
	def tolist(obj1):
		if hasattr(obj1,'__iter__'): return obj1
		else: return [obj1]
	
	def flatten(x):
	    result = []
	    try:
	    	for el in x:
	        	if hasattr(el, "__iter__") and not isinstance(el, basestring):
	        	    result.extend(flatten(el))
	        	else:
	        	    result.append(el)
	    except:
	    	result = x
	    return result
	    
	def analgeom(elem):
		result = []
		try:
			breakstatus = False
			geoms = elem.get_Geometry(opt1)
			extracted = []
			for e in geoms:
				if e.ToString() == "Autodesk.Revit.DB.GeometryInstance":
					try:
						extracted.append(e.GetInstanceGeometry())
					except:
						pass
				elif e.ToString() == "Autodesk.Revit.DB.Solid":
					extracted.append(e)
			if len(extracted) == 0:
				breakstatus = True
			else:
				extracted = flatten(extracted)
				geoms = extracted
			if breakstatus == False:
				for e in geoms:
					try:
						if e.ToString() == "Autodesk.Revit.DB.Solid":
							attempt = e.ToProtoType()
							if attempt == None:
								if len(result) != 0:
									for r in result:
										try: r.Dispose()
										except: pass
								return False
							else:
								result.append(attempt)	
					except:
						if len(result) != 0:
							for r in result:
								try: r.Dispose()
								except: pass
							result = []
							break
			if len(result) == 0:
				return False
			else:
				newresult = []
				for e in result:
					if e != None:
						newresult.append(e)
				if len(newresult) == 0:
					return False
				else:
					return newresult
		except:
			return "Fail"
	
	if geom != None:
		geom = tolist(geom)
	else:
		pass
	
	class WarnSwallow(IFailuresPreprocessor):
		def PreprocessFailures(self, failuresAccessor):
			failuresAccessor.DeleteAllWarnings()
			return FailureProcessingResult.Continue
	
	
	if originalnotjoinedgeom == True:
		from itertools import compress
		from itertools import combinations
		
		elements = flatten(geom)
		allwalls = True
		
		bboxes = []
		accept = []
		for e in elements:
			try:
				bb = e.get_BoundingBox(None)
				bboxes.append(bb.ToProtoType())
				accept.append(True)
			except:
				accept.append(False)
				
		acceptedelements = list(compress(elements, accept))
		
		tocombineraw = combinations(acceptedelements,2)
		tocombinebboxraw = combinations(bboxes,2)
		
		comb = []
		for i in list(tocombineraw): 
		    comb.append(i)
		
		tocombine = comb
		
		comb2 = []
		for i in list(tocombinebboxraw): 
		    comb2.append(i)
		
		tocombinebbox = comb2
		
		if allwalls == False:
			result = []
			allresult = []
			for eachlist in tocombine:
				tmplist = []
				for each in eachlist:
					if str(each.ToString()) == "Autodesk.Revit.DB.Wall":
						tmplist.append(True)
					else:
						tmplist.append(False)
				result.append(tmplist)
		
			for each in result:
				if all(each) == True:
					allresult.append(False)
				else:
					allresult.append(True)
			filtered = list(compress(tocombine, allresult))
			filteredbbox = list(compress(tocombinebbox, allresult))
		else:
			filtered = tocombine
			filteredbbox = tocombinebbox
		
		BBOX1 = [item[0] for item in filteredbbox]
		BBOX2 = [item[1] for item in filteredbbox]
		
		intersects = []
		
		count = 0
		for each in BBOX1:
			intersects.append(dg.BoundingBox.Intersects(each,BBOX2[count]))
			count = count + 1
		
		count = 0
		for each in BBOX1:
			each.Dispose()
			BBOX2[count].Dispose()
			count = count + 1
		
		intersectingelements = list(compress(filtered, intersects))
		
		listj = len(intersectingelements)
		count = 0
		arejoined = []
		while (count < listj):
				result = JoinGeometryUtils.AreElementsJoined(doc, intersectingelements[count][0], intersectingelements[count][1])
				count = count + 1
				arejoined.append(result)
		
		joined = list(compress(intersectingelements, arejoined))
	
	temp_path = System.IO.Path.GetTempPath()
	satOpt = SATExportOptions()
	opt1 = Options()
	
	if includehiddengeom == True:
		opt1.IncludeNonVisibleObjects = True
	
	#Find a 3D view type
	collector1 = FilteredElementCollector(doc)
	viewFamilyTypes = collector1.OfClass((ViewFamilyType))
	for e in viewFamilyTypes:
		if str(e.ViewFamily) == "ThreeDimensional":
			viewType = e.Id
			break
	
	def NewForm_background(s1):
		DocumentManager.Instance.CurrentUIApplication.DialogBoxShowing += on_dialog_open
		TransactionManager.Instance.ForceCloseTransaction()
		try:
			randomname = ''.join([random.choice(string.ascii_letters + string.digits) for n in xrange(5)])
			trans1 = Transaction(doc, 'Fetching Geometry')
			foptions = trans1.GetFailureHandlingOptions()
			foptions.SetFailuresPreprocessor(WarnSwallow())
			trans1.SetFailureHandlingOptions(foptions)
			trans1.Start()
			if originalnotjoinedgeom == True:
				jointcount = 0
				while (jointcount < len(joined)):
					try:
						JoinGeometryUtils.UnjoinGeometry(doc, joined[jointcount][0], joined[jointcount][1])
						jointcount = jointcount + 1
					except:
						jointcount = jointcount +1
				doc.Regenerate()
			sat_path = '%s%s.sat' % (temp_path, randomname)
			status = True
			finalres = []
			for each in s1:
				try:
					oldvalue = 1
					eparm = each.LookupParameter("Visible")
					if eparm != None:
						if doc.FamilyManager.GetAssociatedFamilyParameter(eparm) != None:
							doc.FamilyManager.AssociateElementParameterToFamilyParameter(eparm, None)
						pname = eparm.Definition.Name
						oldvalue = eparm.AsInteger()
						if oldvalue == 0:
							eparm.Set(1)
				except:
					continue
				resultgeom = analgeom(each)
				if resultgeom == "Fail":
					finalres.append([None])
					continue
				elif resultgeom == False:
					resultgeom = []
					threedeeview = View3D.CreateIsometric(doc, viewType)
					threedeeviewid = threedeeview.Id
					try:
						wantedsub = doc.Settings.Categories.get_Item(BuiltInCategory.OST_Mass)
						threedeeview.SetCategoryHidden(wantedsub.Id,False)
					except:
						pass
					kilist = List[ElementId]([threedeeviewid])
					tid = []
					tid = [each.Id]
					ielements = List[ElementId](tid)
					threedeeview.IsolateElementsTemporary(ielements)
					collectorinside = FilteredElementCollector(doc,threedeeviewid).ToElements()
					elemento = []
					for k in collectorinside:
						elemento.append(int(str(k.Id)))
					if int(str(each.Id)) in elemento:
						doc.Export(temp_path, randomname, kilist, satOpt)
						eachlist = betteimport(doc,sat_path,temp_path)
						tmplist = []
						for e in eachlist:
							tmplist.append(e)
						resultgeom.append(tmplist)
						System.IO.File.Delete(sat_path)
					else:
						resultgeom = [None]
					doc.Delete(threedeeview.Id)
				finalres.append(flatten(resultgeom))
				if oldvalue == 0:
					eparm.Set(0)
			trans1.RollBack()
			return finalres
		except:
			trans1.RollBack()
			TransactionManager.Instance.ForceCloseTransaction()
			return traceback.format_exc(),''
	try:
		result = NewForm_background(geom)
		result = flatten(result)
	except:
		result = None
	satOpt.Dispose()
	opt1.Dispose()
	return result
    
doc = DocumentManager.Instance.CurrentDBDocument
app = doc.Application

surfaces = IN[0]
comparesurfs = IN[1]
familytype = UnwrapElement(IN[2])
Udistance = IN[3]
Vdistance = IN[4]
tryrhomboid = IN[5]
borw = IN[6]
uppermode = IN[7]
midheight = IN[8]
createfilter = IN[9]
name = IN[10]

if int(DocumentManager.Instance.CurrentUIApplication.Application.VersionNumber) < 2021:
	safethickfactor = UnitUtils.ConvertFromInternalUnits(1.65,doc.GetUnits().GetFormatOptions(UnitType.UT_Length).DisplayUnits)
else:
	safethickfactor = UnitUtils.ConvertFromInternalUnits(1.65,doc.GetUnits().GetFormatOptions(SpecTypeId.Length).GetUnitTypeId())

if familytype.Family.get_Parameter(BuiltInParameter.FAMILY_HOSTING_BEHAVIOR).AsValueString() == "Face":
	workplanebased = True
else:
	workplanebased = False

if familytype.Family.get_Parameter(BuiltInParameter.FAMILY_WORK_PLANE_BASED).AsInteger() == 1:
	workplanebased = True

if familytype.Family.get_Parameter(BuiltInParameter.FAMILY_HOSTING_BEHAVIOR).AsValueString() == "Ceiling":
	onlyceilings = True
	workplanebased = False
else:
	onlyceilings = False

if familytype.Family.get_Parameter(BuiltInParameter.FAMILY_HOSTING_BEHAVIOR).AsValueString() == "Floor":
	onlyfloors = True
	workplanebased = False
else:
	onlyfloors = False

if familytype.Family.get_Parameter(BuiltInParameter.FAMILY_HOSTING_BEHAVIOR).AsValueString() == "Roof":
	onlyroofs = True
	workplanebased = False
else:
	onlyroofs = False

floors = FilteredElementCollector(doc).OfCategory(BuiltInCategory.OST_Floors).WhereElementIsNotElementType().ToElements()
roofs = FilteredElementCollector(doc).OfCategory(BuiltInCategory.OST_Roofs).WhereElementIsNotElementType().ToElements()
ceilings = FilteredElementCollector(doc).OfCategory(BuiltInCategory.OST_Ceilings).WhereElementIsNotElementType().ToElements()
hosts = list(ceilings) + list(floors) + list(roofs)
	
pts = []
mastercount = 0
for surface in surfaces:
	perimeter = surface.PerimeterCurves()
	permlens = []
	for perm in perimeter:
		permlens.append(perm.Length)
	maxperm = max(permlens)
	permcount = 0
	for permlen in permlens:
		if maxperm == permlen:
			wantedperm = perimeter[permcount]
			wantedvector = dg.Vector.ByTwoPoints(wantedperm.StartPoint,wantedperm.EndPoint)
			break
		permcount += 1
	tocomparewith = dg.Curve.ByIsoCurveOnSurface(surface,0,0)
	vectortocomparewith = dg.Vector.ByTwoPoints(tocomparewith.StartPoint,tocomparewith.EndPoint)
	wantedangle = -1.0 * dg.Vector.AngleWithVector(wantedvector,vectortocomparewith)
	wantedorigin = dg.Surface.PointAtParameter(surface,0.5,0.5)
	wantedaxis = dg.Surface.NormalAtParameter(surface,0.5,0.5)
	testvec = dg.Vector.Rotate(vectortocomparewith,wantedaxis,wantedangle)
	isparallel = dg.Vector.IsParallel(testvec,wantedvector)
	if isparallel == False:
		wantedangle *= -1
	ulen = dg.Geometry.Rotate(dg.Curve.ByIsoCurveOnSurface(surface,0,0.5),wantedorigin,wantedaxis,wantedangle)
	vlen = dg.Geometry.Rotate(dg.Curve.ByIsoCurveOnSurface(surface,0,0.5),wantedorigin,wantedaxis,wantedangle)
	midpoint = dg.Surface.PointAtParameter(surface,0.5,0.5)
	comp1 = dg.Surface.PointAtParameter(surface,0,0.5)
	comp2 = dg.Surface.PointAtParameter(surface,0.5,0)
	dis1 = dg.Geometry.DistanceTo(midpoint,comp1)
	dis2 = dg.Geometry.DistanceTo(midpoint,comp2)
	wantedparm1 = (Vdistance * 0.5) / dis1
	wantedparm2 = (Udistance * 0.5) / dis2
	times1 = range(0,int(math.ceil(1.0/wantedparm1)),1)
	times2 = range(0,int(math.ceil(1.0/wantedparm2)),1)
	parms1list = []
	start1 = 0.5
	for time1 in times1:
		parms1list.append(start1)
		parms1list.append(1-start1)
		start1 += wantedparm1
	parms1list = sorted(get_unique_numbers(parms1list))
	parms2list = []
	start2 = 0.5
	for time2 in times2:
		parms2list.append(start2)
		parms2list.append(1-start2)
		start2 += wantedparm2
	parms2list = sorted(get_unique_numbers(parms2list))
	isos1 = []
	isos2 = []
	tmp_pts = []
	for par1 in parms1list:
		isos1.append(dg.Geometry.Rotate(dg.Curve.ByIsoCurveOnSurface(surface,1,par1),wantedorigin,wantedaxis,wantedangle).ExtendStart(maxperm).ExtendEnd(maxperm))
	for par2 in parms2list:
		isos2.append(dg.Geometry.Rotate(dg.Curve.ByIsoCurveOnSurface(surface,0,par2),wantedorigin,wantedaxis,wantedangle).ExtendStart(maxperm).ExtendEnd(maxperm))
	for iso1 in isos1:
		for iso2 in isos2:
			tmp_pts.append(dg.Geometry.Intersect(iso1,iso2))
	tmp_pts = flatten(tmp_pts)
	cleaned_tmp_xyz = []
	cleaned_tmp = []
	for tmp in tmp_pts:
		if dg.Geometry.DoesIntersect(tmp,comparesurfs[mastercount]):
			cleaned_tmp_xyz.append(tmp.ToXyz())
			cleaned_tmp.append(tmp)
	pts.append([cleaned_tmp,wantedangle])
	mastercount += 1

faces = []
for host in hosts:
	try:
		if uppermode:
			refsbottom = HostObjectUtils.GetBottomFaces(host)
		else:
			refsbottom = HostObjectUtils.GetTopFaces(host)
		for refbottom in refsbottom:
			if refbottom != None:
				face = host.GetGeometryObjectFromReference(refbottom)
				if face != None:
					try:
						try:
							loops = face.EdgeLoops
							numloops = len(list(loops))
							if numloops > 1:
								operate = operateframes([face.ToProtoType()],safethickfactor/2.0,borw)[0]
								for op in operate:
									faces.append([tolist(op),refbottom,host])
							else:
								faces.append([face.ToProtoType(),refbottom,host])
						except:
							faces.append([face.ToProtoType(),refbottom,host])
					except:
						checkpts = []
						loops = face.EdgeLoops
						numloops = len(list(loops))
						loops = flatten(loops)
						for loop in loops:
							checkpts.append(loop.AsCurve().Evaluate(0.5,True).ToPoint())
						body = PROgetgeom(doc,host)
						exploded = []
						for bod in body:
							explode = dg.Geometry.Explode(bod)
							for explo in explode:
								exploded.append(explo)
						isgood = False
						for exp in exploded:
							for checkpt in checkpts:
								if dg.Geometry.DistanceTo(exp,checkpt) < 0.1:
									isgood = True
								else:
									isgood = False
							if isgood:
								break
						if numloops > 1:
							operate = operateframes([exp],safethickfactor/2.0,borw)[0]
							for op in operate:
								faces.append([tolist(op),refbottom,host])
						else:
							faces.append([[exp],refbottom,host])
	except:
		pass

ptsmasterall = pts
projectedall = []
hostsall = []
refsall = []
vectorsall = []
purefacesall = []
planesall = []

for ptsall in ptsmasterall:
	pts = ptsall[0]
	projected = []
	vectors = []
	hosts = []
	refs = []
	purefaces = []
	planes = []
	for pt in pts:
		tmp = []
		distances = []
		projected_tmp = []
		hosts_tmp = []
		refs_tmp = []
		faces_tmp = []
		planes_tmp = []
		for faces_with_host in faces:
			faces_group = faces_with_host[0]
			for face in faces_group:
				newpoints = dg.Surface.ProjectInputOnto(face,pt,dg.Vector.ZAxis())
				for newpoint in newpoints:
					if uppermode:
						if newpoint.Z > pt.Z and dg.Geometry.DoesIntersect(newpoint,face):
							tmp.append(newpoint)
							distances.append(dg.Geometry.DistanceTo(pt,newpoint))
					else:
						if round(newpoint.Z,3) == round(pt.Z,3) and dg.Geometry.DoesIntersect(newpoint,face):
							tmp.append(newpoint)
							distances.append(dg.Geometry.DistanceTo(pt,newpoint))
						elif round(newpoint.Z,3) < round(pt.Z,3) and dg.Geometry.DoesIntersect(newpoint,face):
							tmp.append(newpoint)
							distances.append(dg.Geometry.DistanceTo(pt,newpoint))
				if len(tmp) > 0:
					try:
						mindis = min(distances)
						counter = 0
						for distance in distances:
							if mindis == distance:
								planes_tmp.append(dg.CoordinateSystem.ByPlane(dg.Geometry.Rotate(dg.Plane.ByOriginNormalXAxis(tmp[counter],dg.Surface.NormalAtPoint(face,tmp[counter]),dg.Vector.XAxis()),tmp[counter],dg.Surface.NormalAtPoint(face,tmp[counter]),ptsall[1])))
								projected_tmp.append(tmp[counter])
								hosts_tmp.append(faces_with_host[2])
								refs_tmp.append(faces_with_host[1])
								faces_tmp.append(face)
								break
							counter += 1
					except:
						continue
		if len(projected_tmp) > 0:
			pruned = dg.Point.PruneDuplicates(projected_tmp)
			projected.append(pruned[0])
			hosts.append(hosts_tmp[0])
			refs.append(refs_tmp[0])
			vectors.append(dg.Surface.NormalAtPoint(faces_tmp[0],pruned[0]))
			purefaces.append(faces_tmp[0])
			planes.append(planes_tmp[0])
	projectedall.append(projected)
	hostsall.append(hosts)
	refsall.append(refs)
	vectorsall.append(vectors)
	purefacesall.append(purefaces)
	planesall.append(planes)
	
projectedall = flatten(projectedall)
hostsall = flatten(hostsall)
refsall = flatten(refsall)
vectorsall = flatten(vectorsall)
purefacesall = flatten(purefacesall)
planesall = flatten(planesall)

if len(projectedall) > 0:
	if tryrhomboid:
		allpruned = dg.Point.PruneDuplicates(projectedall,min(Udistance,Vdistance)/0.75)
	else:
		allpruned = dg.Point.PruneDuplicates(projectedall,min(Udistance,Vdistance)/1.2)

	finalpruned = []
	finalhosts = []
	finalrefs = []
	finalvectors = []
	familyresult = []
	finalpurefaces = []
	finalplanes = []
	for prune in allpruned:
		count = 0
		for project in projectedall:
			if prune == project:
				finalpruned.append(projectedall[count])
				finalhosts.append(hostsall[count])
				finalrefs.append(refsall[count])
				finalvectors.append(vectorsall[count])
				finalpurefaces.append(purefacesall[count])
				finalplanes.append(planesall[count])
				break
			count += 1
	
	TransactionManager.Instance.ForceCloseTransaction()
	tGroup = TransactionGroup(doc, 'Doing Magic')
	tGroup.Start()
	trans1 = Transaction(doc, 'Placing Families')
	trans1.Start()
	warnhandle = WarnSwallowSimple()
	foptions = trans1.GetFailureHandlingOptions()
	foptions.SetFailuresPreprocessor(warnhandle)
	trans1.SetFailureHandlingOptions(foptions)
	results = []
	count = 0
	for thereference in finalrefs:
		thecoordination = finalplanes[count]
		thelocation = finalpruned[count]
		if uppermode == False:
			newZ = thelocation.Z + midheight
			thelocation = dg.Point.ByCoordinates(thelocation.X,thelocation.Y,newZ)
		theface = finalpurefaces[count]
		thehost = finalhosts[count]
		if not familytype.IsActive: familytype.Activate()
		try:
			if workplanebased:
				results.append(doc.Create.NewFamilyInstance(thereference,thelocation.ToXyz(),thecoordination.XAxis.ToXyz(),familytype))
			else:
				if onlyceilings or onlyfloors or onlyroofs:
					results.append(doc.Create.NewFamilyInstance(thelocation.ToXyz(),familytype,thehost,Structure.StructuralType.NonStructural))
				else:
					results.append(doc.Create.NewFamilyInstance(thelocation.ToXyz(),familytype,Structure.StructuralType.NonStructural))
		except:
			pass
		count += 1
	doc.Regenerate()
	trans1.Commit()
	trans2 = Transaction(doc, 'Delete Duplicated Families')
	trans2.Start()
	warnhandle = WarnSwallowSimple()
	foptions = trans2.GetFailureHandlingOptions()
	foptions.SetFailuresPreprocessor(warnhandle)
	trans2.SetFailureHandlingOptions(foptions)
	existedelements = [x for x in FilteredElementCollector(doc).OfClass(FamilyInstance).ToElements() if x.Symbol.FamilyName == familytype.FamilyName]
	elements = flatten(existedelements + results)
	ids = []
	for e in elements:
		try:
			ids.append(e.Id)
		except:
			pass
	tofix = []
	wlist = doc.GetWarnings()
	for warn in wlist:
		wtext = warn.GetDescriptionText()
		if wtext == "There are identical instances in the same place. This will result in double counting in schedules.":
			welt = warn.GetFailingElements()
			good = True
			for el in welt:
				if el in ids:
					pass
				else:
					good = False
					break
			if good:
				tofix.append(welt)
	result = []
	for tf in tofix: 
		try:
			doc.Delete(tf[1])
			result.append(doc.GetElement(tf[0]))
		except:
			pass
	if createfilter:
		ids = []
		for r in results:
			ids.append(r.Id)
		itemset = List[ElementId](ids)
		filters = FilteredElementCollector(doc).OfClass(FilterElement).ToElements();
		newfilters = []
		for each in filters:
			if each.Name.lower().startswith("dynamo") and each.IsEmpty():
				doc.Delete(each.Id)
			else:
				newfilters.append(each)
		filters = newfilters
		selset = False
		for each in filters:
			if each.Name.lower() == name.lower():
				selset = each
		if selset == False:
			selset = SelectionFilterElement.Create(doc,name)
		selset.AddSet(itemset)
			
	trans2.Commit()
	tGroup.Assimilate()
	if len(result) == 0:
		result = results
	OUT = result
else:
	OUT = "Nothing to do"
# ----------------------------------------
VARFamilyInstances = Output(python_script)
