# Dynamo custom node Points Refine Levels and Offset.dyf (Dynamo 2.1.0.7500)
# category: Synthesize.Automate.Family
# Family Refine Levels and Offset

code_block = CodeBlock { 1; }
VARPoints = Input(VARPoints: var[]..[])
code_block_2 = CodeBlock { false; }
clean = List.Clean(list=VARPoints, preserveIndices=code_block_2)
flatten = List.Flatten(list=clean)
Z = Point.Z(point=VARPoints)
VARLevels = Input(VARLevels: var[]..[])
code_block_3 = CodeBlock { "Level"; }
byClassName = Custom[SP.Filter.ByClassName](VARobject=VARLevels, VARclassName=code_block_3)  # Filters a list of objects by the object's class name. Note that Dynamo elements belong to different classes than their Revit counterparts. Use the Object.Class node to check an object's class.
projectElevation = Level.ProjectElevation()  # unwired: level
sortByFunction = List.SortByFunction(list=byClassName.VARin, func=projectElevation)
count = List.Count(list=VARPoints)
cycle = List.Cycle(list=sortByFunction, amount=count)
count_2 = List.Count(list=sortByFunction)
chop = List.Chop(list=cycle, lengths=count_2)
code_block_4 = CodeBlock { 1; }
chop_2 = List.Chop(list=sortByFunction, lengths=code_block_4)
plane = Custom[CW.Level.Plane](VARlevel=chop_2)  # Retrieves the plane of a given level
boundingBox = Geometry.BoundingBox(geometry=plane)
flatten_2 = List.Flatten(list=boundingBox)
minPoint = BoundingBox.MinPoint(boundingBox=flatten_2)
maxPoint = BoundingBox.MaxPoint(boundingBox=flatten_2)
X = Point.X(point=maxPoint)
VARFixFactorDependsofProjectUnits1Formet = Input(VARFixFactorDependsofProjectUnits1Formetersforexampleand100forCentimeters: var[]..[])
mul = X * VARFixFactorDependsofProjectUnits1Formet
Y = Point.Y(point=maxPoint)
mul_2 = Y * VARFixFactorDependsofProjectUnits1Formet
projectElevation_2 = Level.ProjectElevation(level=sortByFunction)
code_block_5 = CodeBlock { -1; }
shiftIndices = List.ShiftIndices(list=projectElevation_2, amount=code_block_5)
getKeys = GetKeys(list=shiftIndices)
lastItem = List.LastItem(list=getKeys)
maximumItem = List.MaximumItem(list=shiftIndices)
code_block_6 = CodeBlock { 2; }
mul_3 = maximumItem * code_block_6
replaceItemAtIndex = List.ReplaceItemAtIndex(list=shiftIndices, index=lastItem, item=mul_3)
dm_fix_point_bycoordinates_range = Custom[DM.Fix Point.ByCoordinates Range](VARx=mul, VARy=mul_2, VARz=replaceItemAtIndex)  # Dummy Node to fix the modelling range warning
byCorners = BoundingBox.ByCorners(min=minPoint, max=dm_fix_point_bycoordinates_range)
contains = BoundingBox.Contains(boundingBox=byCorners, point=VARPoints@L1)
filterByBoolMask = List.FilterByBoolMask(list=chop, mask=contains)
python_empty_2_null = Custom[Python Empty 2 Null](VARIN=filterByBoolMask.in)  # Python Null 2 Empty
code_block_7 = CodeBlock { null; }
replaceEmptyLists = Custom[CW.List.ReplaceEmptyLists](VARseq=python_empty_2_null, VARReplacement=code_block_7)  # Replaces all empty lists within a given list with a substitute
rank = List.Rank(list=replaceEmptyLists)
normalizeDepth = List.NormalizeDepth(list=replaceEmptyLists, rank=rank)
code_block_8 = CodeBlock { 1; }
chop_3 = List.Chop(list=normalizeDepth, lengths=code_block_8)
flatten_3 = List.Flatten(list=chop_3@L2)
projectElevation_3 = Level.ProjectElevation()  # unwired: level
sortByFunction_2 = List.SortByFunction(list=flatten_3@L2, func=projectElevation_3)
lastItem_2 = List.LastItem(list=sortByFunction_2@L2)
bk_find_nearest_revit_level_for = Custom[BK.Find Nearest Revit Level for a Given Z value](VARzvalue=Z@L1)
flatten_4 = List.Flatten(list=bk_find_nearest_revit_level_for)
isNull = Object.IsNull()  # unwired: obj
replaceByCondition = Replace(item=lastItem_2, replaceWith=flatten_4, condition=isNull)
flatten_5 = List.Flatten(list=replaceByCondition)
projectElevation_4 = Level.ProjectElevation(level=flatten_5)
sub = Z - projectElevation_4
code_block_9 = CodeBlock { false; }
clean_2 = List.Clean(list=sub, preserveIndices=code_block_9)
VARElevationsSet = Output(clean_2)
VARLevelsSet = Output(flatten_5)
VARSelectedLevels = Output(sortByFunction)
