# Dynamo custom node Prepare K-Paneling Divied Paths UV.dyf (Dynamo 2.1.0.7500)
# category: Synthesize.Automate.Lines
# Prepare K-Paneling Divied Paths UV

VARFaces = Input(VARFaces: var[]..[])
flatten = List.Flatten(list=VARFaces)
turnIntoList = Custom[CW.TurnIntoList](VARunknownItem=flatten)  # Turns an element (or a nested list) into a flat list
flatten_2 = List.Flatten(list=turnIntoList)
VARSurfaces = Output(flatten_2)
VARDividedPaths = Input(VARDividedPaths: var[]..[])
code_block = CodeBlock { "DividedPath"; }
byClassName = Custom[SP.Filter.ByClassName](VARobject=VARDividedPaths, VARclassName=code_block)  # Filters a list of objects by the object's class name. Note that Dynamo elements belong to different classes than their Revit counterparts. Use the Object.Class node to check an object's class.
turnIntoList_2 = Custom[CW.TurnIntoList](VARunknownItem=byClassName.VARin)
flatten_3 = List.Flatten(list=turnIntoList_2)
python_script = Python(IN[0]=flatten_3)
# ---------- python_script.python (69 lines) ----------
# Enable Python support and load DesignScript library
# IMPORTANT : ALL DYNAMO DESIGN SCRIPT NODES ARE AS (dg)
import clr
clr.AddReference('ProtoGeometry')
from Autodesk.DesignScript import Geometry as dg

# EXTENSION Enable ToDSType
clr.AddReference('RevitNodes')
import Revit
clr.ImportExtensions(Revit.Elements)

# Enable Revit Elements
from Revit.Elements import *

# EXTENSION Enable Geometry Conversion Methods
clr.ImportExtensions(Revit.GeometryConversion)

# Enable Revit API
clr.AddReference('RevitAPI')
from Autodesk.Revit.DB import *

# Enable DocumentManager and TransactionManager
clr.AddReference('RevitServices')
from RevitServices.Persistence import DocumentManager
from RevitServices.Transactions import TransactionManager

# Enable ICollection List Translate
clr.AddReference("System")
import System.Collections.Generic
from System.Collections.Generic import List

dataEnteringNode = IN
# Use UnwrapElement(IN[0]) When Translating From Dynamo to Revit
elems=IN[0]

# Choose The Current Document
doc = DocumentManager.Instance.CurrentDBDocument
uidoc = DocumentManager.Instance.CurrentUIApplication.ActiveUIDocument
uiapp = DocumentManager.Instance.CurrentUIApplication
app = uiapp.Application

# Create Empty List
result = []

Us = []
Vs = []
Ws = []

for e in elems:
	e = doc.GetElement(ElementId(e.Id))
	try:
		parms = e.GetOrderedParameters()
		for parm in parms:
			parname = parm.Definition.Name.lower()
			if parname == "comments":
				name = parm.AsString().lower()
		if "u" in name:
			Us.append(e)
		elif "v" in name:
			Vs.append(e)
		elif "w" in name:
			Ws.append(e)
		else:
			Us.append(e)
	except:
		Us.append(e)
		
# Assign your output to the OUT variable.
OUT = Us,Vs,Ws
# ----------------------------------------
code_block_2 = CodeBlock(u=python_script, v=python_script, w=python_script) { u[0]; v[1]; w[2]; }
planes_and_curve_of_divided_path = Custom[Planes and Curve of Divided Path](VARDividedPaths=code_block_2.out0)  # Planes and Curve of Divided Path
flatten_4 = List.Flatten(list=planes_and_curve_of_divided_path.VARPlanes)
removeCoincidentPlanes = Custom[RemoveCoincidentPlanes](VARPlanes=flatten_4)  # RemoveCoincidentPlanes
intersect = Geometry.Intersect(geometry=flatten_2@L1, other=removeCoincidentPlanes)
flatten_5 = List.Flatten(list=intersect)
code_block_3 = CodeBlock { "Point"; }
byClassName_2 = Custom[SP.Filter.ByClassName](VARobject=flatten_5, VARclassName=code_block_3)
flatten_6 = List.Flatten(list=byClassName_2.VARout)
group_curves_by_surfaces = Custom[Group Curves By Surfaces](VARSurfaces=flatten_2, VARCurves=flatten_6)  # Group Curves By Surfaces
planes_and_curve_of_divided_path_2 = Custom[Planes and Curve of Divided Path](VARDividedPaths=code_block_2.out1)
flatten_7 = List.Flatten(list=planes_and_curve_of_divided_path_2.VARPlanes)
removeCoincidentPlanes_2 = Custom[RemoveCoincidentPlanes](VARPlanes=flatten_7)
intersect_2 = Geometry.Intersect(geometry=flatten_2@L1, other=removeCoincidentPlanes_2)
flatten_8 = List.Flatten(list=intersect_2)
byClassName_3 = Custom[SP.Filter.ByClassName](VARobject=flatten_8, VARclassName=code_block_3)
flatten_9 = List.Flatten(list=byClassName_3.VARout)
group_curves_by_surfaces_2 = Custom[Group Curves By Surfaces](VARSurfaces=flatten_2, VARCurves=flatten_9)
planes_and_curve_of_divided_path_3 = Custom[Planes and Curve of Divided Path](VARDividedPaths=code_block_2.out2)
flatten_10 = List.Flatten(list=planes_and_curve_of_divided_path_3.VARPlanes)
removeCoincidentPlanes_3 = Custom[RemoveCoincidentPlanes](VARPlanes=flatten_10)
intersect_3 = Geometry.Intersect(geometry=flatten_2@L1, other=removeCoincidentPlanes_3)
flatten_11 = List.Flatten(list=intersect_3)
byClassName_4 = Custom[SP.Filter.ByClassName](VARobject=flatten_11, VARclassName=code_block_3)
flatten_12 = List.Flatten(list=byClassName_4.VARout)
group_curves_by_surfaces_3 = Custom[Group Curves By Surfaces](VARSurfaces=flatten_2, VARCurves=flatten_12)
create = List.Create(item0=group_curves_by_surfaces.VARCurves, item1=group_curves_by_surfaces_2.VARCurves, item2=group_curves_by_surfaces_3.VARCurves)
transpose = List.Transpose(lists=create)
code_block_4 = CodeBlock { 0; 1; 2; }
U = List.GetItemAtIndex(list=transpose@@L3, index=code_block_4.out0)
python_empty_2_null = Custom[Python Empty 2 Null](VARIN=U)  # Python Null 2 Empty
as_polycurve_bycurves_with = Custom[AS.[&] PolyCurve.ByCurves With Failures](VARcurves=python_empty_2_null)  # Create polycurves from an unordered list of curves.
code_block_5 = CodeBlock { 2; }
normalizeDepth = List.NormalizeDepth(list=as_polycurve_bycurves_with.VARpolyCurve, rank=code_block_5)
VARU = Output(normalizeDepth)
V = List.GetItemAtIndex(list=transpose@@L3, index=code_block_4.out1)
python_empty_2_null_2 = Custom[Python Empty 2 Null](VARIN=V)
as_polycurve_bycurves_with_2 = Custom[AS.[&] PolyCurve.ByCurves With Failures](VARcurves=python_empty_2_null_2)
normalizeDepth_2 = List.NormalizeDepth(list=as_polycurve_bycurves_with_2.VARpolyCurve, rank=code_block_5)
VARV = Output(normalizeDepth_2)
W = List.GetItemAtIndex(list=transpose@@L3, index=code_block_4.out2)
python_empty_2_null_3 = Custom[Python Empty 2 Null](VARIN=W)
as_polycurve_bycurves_with_3 = Custom[AS.[&] PolyCurve.ByCurves With Failures](VARcurves=python_empty_2_null_3)
normalizeDepth_3 = List.NormalizeDepth(list=as_polycurve_bycurves_with_3.VARpolyCurve, rank=code_block_5)
VARW = Output(normalizeDepth_3)
