# Dynamo custom node Prune.TolleranceFixer.dyf (Dynamo 2.1.0.7500)
# category: Synthesize.Fixers
# Prune Duplicates Fixer

VARPruneTollerance = Input(VARPruneTollerance: double = 0.001)
python_script = Python(IN[0]=VARPruneTollerance)
# ---------- python_script.python (13 lines) ----------
import clr
clr.AddReference('RevitAPI')
from Autodesk.Revit.DB import *
clr.AddReference('RevitServices')
from RevitServices.Persistence import DocumentManager
doc = DocumentManager.Instance.CurrentDBDocument

prune = IN[0]

if int(DocumentManager.Instance.CurrentUIApplication.Application.VersionNumber) == 2022:
	prune = UnitUtils.ConvertToInternalUnits(prune,doc.GetUnits().GetFormatOptions(SpecTypeId.Length).GetUnitTypeId())

OUT = prune
# ----------------------------------------
VARPruneTollerance_2 = Output(python_script)  # "VARPruneTollerance"
