# Dynamo custom node Python All Elements In All Document.dyf (Dynamo 2.1.0.7500)
# category: Synthesize.Python
# Python All Elements In All Document

python_script = Python()  # unwired: IN[0]
# ---------- python_script.python (38 lines) ----------
# Enable Python support and load DesignScript library
# IMPORTANT : ALL DYNAMO DESIGN SCRIPT NODES ARE AS (dg)
import clr
clr.AddReference('ProtoGeometry')
from Autodesk.DesignScript import Geometry as dg

# EXTENSION Enable ToDSType
clr.AddReference('RevitNodes')
import Revit
clr.ImportExtensions(Revit.Elements)

# Enable Revit Elements
from Revit.Elements import *

# EXTENSION Enable Geometry Conversion Methods
clr.ImportExtensions(Revit.GeometryConversion)

# Enable Revit API
clr.AddReference('RevitAPI')
from Autodesk.Revit.DB import *

# Enable DocumentManager and TransactionManager
clr.AddReference('RevitServices')
from RevitServices.Persistence import DocumentManager
from RevitServices.Transactions import TransactionManager

# Enable ICollection List Translate
clr.AddReference("System")
import System.Collections.Generic
from System.Collections.Generic import List


doc = DocumentManager.Instance.CurrentDBDocument

collector = FilteredElementCollector(doc).WhereElementIsNotElementType().ToElements();

#Assign your output to the OUT variable.
OUT = collector
# ----------------------------------------
VARElements = Output(python_script)
