# Dynamo custom node Python Filter List From Another List.dyf (Dynamo 2.1.0.7500)
# category: Synthesize.Python
# Find Intersections In Lists

VARItemsToFilter = Input(VARItemsToFilter: var[]..[])
VARAllItemsToFilterFrom = Input(VARAllItemsToFilterFrom: var[]..[])
python_script = Python(IN[0]=VARItemsToFilter, IN[1]=VARAllItemsToFilterFrom)
# ---------- python_script.python (6 lines) ----------
import clr
clr.AddReference('ProtoGeometry')
from Autodesk.DesignScript.Geometry import *

#Assign your output to the OUT variable.
OUT = OUT = set(IN[1]) - (set(IN[1]) - set(IN[0]))
# ----------------------------------------
VARItems = Output(python_script)
