# Dynamo custom node RA.String.RemoveFromBegin.dyf (Dynamo 2.1.0.7500)
# category: Synthesize.Packages.ReAnimation.String
# Remove characters from the beginning of a string by a given amount

VARStr = Input(VARStr: string)
VARNumberToRemove = Input(VARNumberToRemove: int = 1)
python_script = Python(IN[0]=VARStr, IN[1]=VARNumberToRemove)
# ---------- python_script.python (18 lines) ----------
# Copyright (c)2017 By Travis M Williams
import clr
import sys
sys.path.append('C:\Program Files (x86)\IronPython 2.7\Lib')

# Variables
inString = UnwrapElement(IN[0])
indexCount = UnwrapElement(IN[1])
stringLength = inString.Length

# Code
if indexCount < stringLength:
	outString = inString[indexCount:stringLength]
else:
	outString = "String length is less than length of removed characters"

# Output
OUT = outString
# ----------------------------------------
VARStr_2 = Output(python_script)  # "VARStr"
