# Dynamo custom node RH.Element.SetPinnedStatus.dyf (Dynamo 2.1.0.7500)
# category: Synthesize.Packages.Rhythm.Revit.Elements.Element.Actions
# Will set the element to either pinned or not pinned. True is pinned, false is unpinned. For multiple elements use List.Map

VARelement = Input(VARelement: var[]..[])
code_block = CodeBlock(item=VARelement) { DSCore.List.Flatten([item]); }
VARBool = Input(VARBool: bool = false)
python_script = Python(IN[0]=code_block, IN[1]=VARBool)
# ---------- python_script.python (46 lines) ----------
#Copyright(c) 2017, john pierson
# @60secondrevit, http://sixtysecondrevit.com
import clr
clr.AddReference('ProtoGeometry')
from Autodesk.DesignScript.Geometry import *

# Import ToDSType(bool) extension method
clr.AddReference("RevitNodes")
import Revit
clr.ImportExtensions(Revit.Elements)

# Import DocumentManager and TransactionManager
clr.AddReference("RevitServices")
import RevitServices
from RevitServices.Persistence import DocumentManager
from RevitServices.Transactions import TransactionManager

from System.Collections.Generic import *

# Import RevitAPI
clr.AddReference("RevitAPI")
import Autodesk

doc = DocumentManager.Instance.CurrentDBDocument
uiapp = DocumentManager.Instance.CurrentUIApplication
app = uiapp.Application

#The inputs to this node will be stored as a list in the IN variable.
dataEnteringNode = IN

#unwrap all elements to use with API
items = UnwrapElement(IN[0])
TransactionManager.Instance.EnsureInTransaction(doc)
#SEt pinned status over list
typelist = list()
for i in items:
	try:
		i.Pinned = IN[1]
	except:
		typelist.append(list())

# "End" the transaction
TransactionManager.Instance.TransactionTaskDone()

#Assign your output to the OUT variable
OUT = IN[0]
# ----------------------------------------
VARelement_2 = Output(python_script)  # "VARelement"
