# Dynamo custom node RH.Output.Clean.dyf (Dynamo 2.1.0.7500)
# category: Synthesize.Packages.Rhythm.Core.List.Actions
# This will return a single value or list from one input.

VARinput = Input(VARinput: var[]..[])
count = List.Count(list=VARinput)
code_block = CodeBlock(input=count) { input>1; }
firstItem = List.FirstItem(list=VARinput)

# group: Special thanks to Mark Thorley for this definition
code_block_2 = CodeBlock(test=code_block, iftrue=VARinput, iffalse=firstItem) { oldif(test,iftrue,iffalse); }
code_block_3 = CodeBlock()
# ---------- code_block_3.designscript (15 lines) ----------
def oldif(test,iftrue:var[]..[],
iffalse:var[]..[])
{
return = [Imperative]
{
if (test)
{
return = iftrue;
}
else
{
return = iffalse;
}
}
};
# ----------------------------------------

VARresult = Output(code_block_2)
