# Dynamo custom node RH.ReferencePlane.GetCurvesInView.dyf (Dynamo 2.1.0.7500)
# category: Synthesize.Packages.Rhythm.Revit.Elements.ReferencePlane
# This will obtain the geometric curves of the reference plane in a given view. Revit 2016+

VARreferencePlane = Input(VARreferencePlane: Revit.Elements.ReferencePlane)
code_block = CodeBlock(item=VARreferencePlane) { DSCore.List.Flatten([item]); }
python_script = Python()
# ---------- python_script.python (41 lines) ----------
#Copyright(c) 2017, john pierson
# @60secondrevit, http://sixtysecondrevit.com
import clr
clr.AddReference('ProtoGeometry')
from Autodesk.DesignScript.Geometry import *

# Import ToDSType(bool) extension method
clr.AddReference("RevitNodes")
import Revit
clr.ImportExtensions(Revit.Elements)

# Import DocumentManager and TransactionManager
clr.AddReference("RevitServices")
import RevitServices
from RevitServices.Persistence import DocumentManager
from RevitServices.Transactions import TransactionManager

from System.Collections.Generic import *

# Import RevitAPI
clr.AddReference("RevitAPI")
from Autodesk.Revit.DB import*

doc = DocumentManager.Instance.CurrentDBDocument
uiapp = DocumentManager.Instance.CurrentUIApplication
app = uiapp.Application

#The inputs to this node will be stored as a list in the IN variable.
dataEnteringNode = IN

#unwrap all elements to use with API

TransactionManager.Instance.EnsureInTransaction(doc)
#apply lineweight override to elements in an input list


# "End" the transaction
TransactionManager.Instance.TransactionTaskDone()

#Assign your output to the OUT variable
OUT = DatumExtentType()
# ----------------------------------------
VARview = Input(VARview: var[]..[])
python_script_2 = Python(IN[0]=code_block, IN[1]=python_script, IN[2]=VARview)
# ---------- python_script_2.python (60 lines) ----------
#Copyright(c) 2017, john pierson
# @60secondrevit, http://sixtysecondrevit.com
import clr
clr.AddReference('ProtoGeometry')
from Autodesk.DesignScript.Geometry import *

# Import ToDSType(bool) extension method
clr.AddReference("RevitNodes")
import Revit
clr.ImportExtensions(Revit.Elements)
clr.ImportExtensions(Revit.GeometryConversion)

# Import DocumentManager and TransactionManager
clr.AddReference("RevitServices")
import RevitServices
from RevitServices.Persistence import DocumentManager
from RevitServices.Transactions import TransactionManager

from System.Collections.Generic import *

# Import RevitAPI
clr.AddReference("RevitAPI")
import Autodesk

doc = DocumentManager.Instance.CurrentDBDocument
uiapp = DocumentManager.Instance.CurrentUIApplication
app = uiapp.Application

#The inputs to this node will be stored as a list in the IN variable.
dataEnteringNode = IN
def flatten(*args):
    for x in args:
        if hasattr(x, '__iter__'):
            for y in flatten(*x):
                yield y
        else:
            yield x

#unwrap all elements to use with API
rPlanes = UnwrapElement(IN[0])
view = UnwrapElement(IN[2])

#get the revit.db.line for the reference planes
revitCurves = list()
for i in rPlanes:
	try:
		revitCurves.append(i.GetCurvesInView(IN[1],view))
	except:
		revitCurves.append(list())

#convert to dynamo lines
revitCurvesFlat = flatten(revitCurves)
dynamoCurves = list()
for r in revitCurvesFlat:
	try:
		dynamoCurves.append(r.ToProtoType())
	except:
		dynamoCurves.append(list())
#Assign your output to the OUT variable
OUT = dynamoCurves
# ----------------------------------------
clean = Custom[RH.Output.Clean](VARinput=python_script_2)  # This will return a single value or list from one input.
VARcurve = Output(clean)
