# Dynamo custom node RH.RemoveListFromList.dyf (Dynamo 2.1.0.7500)
# category: Synthesize.Packages.Rhythm.Core.List.Actions
# This node essentially "subtracts" the contents of List B from List A to produce a new list with the unique items.

VARListA = Input(VARListA: var[]..[])
VARListB = Input(VARListB: var[]..[])
python_script = Python(IN[0]=VARListA, IN[1]=VARListB)
# ---------- python_script.python (12 lines) ----------
import clr
clr.AddReference('ProtoGeometry')
from Autodesk.DesignScript.Geometry import *
#The inputs to this node will be stored as a list in the IN variable.
dataEnteringNode = IN

def tolist(obj1):
	if hasattr(obj1,'__iter__'): return obj1
	else: return [obj1]

#Assign your output to the OUT variable
OUT = set(tolist(IN[0])) - set(tolist(IN[1]))
# ----------------------------------------
VARList = Output(python_script)
