# Dynamo custom node RH.Rhythm.RenumberGridsByCurve.dyf (Dynamo 2.1.0.7500)
# category: Synthesize.Packages.Rhythm.Tools
# This node will renumber grids in order of curve drawn through them. Select either letters or numbers. (Alphanumeric coming soon)

VARmodelCurve = Input(VARmodelCurve: var[]..[])
rh_select_grids_by_curve = Custom[RH.Select Grids By Curve](VARmodelCurve=VARmodelCurve)  # This will select Revit grids by the input Revit curve,
string = StringInput("Name")  # graph input
VARstartCharacter = Input(VARstartCharacter: var[]..[])
count = List.Count(list=rh_select_grids_by_curve)
string_2 = StringInput("Name")  # graph input
code_block = CodeBlock { 0; 9000; 1; }
count_2 = List.Count(list=rh_select_grids_by_curve)
code_block_2 = CodeBlock { 2; }
add = count_2 + code_block_2
lb_lunchbox_random_numbers = Custom[LB.LunchBox Random Numbers](VARMin=code_block.out0, VARMax=code_block.out1, VARAmount=add@L1, VARSeed=code_block.out2)  # Generates a list of Random numbers using a domain, amount, and seed.
hot_index_of_item = Custom[HOT.Index of item](VARList=lb_lunchbox_random_numbers@L2, VARItem=code_block.out0@L1, lacing=Longest)  # Index of Item on List
removeItemAtIndex = List.RemoveItemAtIndex(list=lb_lunchbox_random_numbers@L2, indices=hot_index_of_item@L2)
hot_index_of_item_2 = Custom[HOT.Index of item](VARList=removeItemAtIndex@L2, VARItem=code_block.out1@L1, lacing=Longest)
removeItemAtIndex_2 = List.RemoveItemAtIndex(list=removeItemAtIndex@L2, indices=hot_index_of_item_2@L2)
flatten = List.Flatten(list=removeItemAtIndex_2)
string_from_object = FromObject(obj=flatten)
setParameterByName = Element.SetParameterByName(element=rh_select_grids_by_curve, parameterName=string_2, value=string_from_object)
passthrough = Custom[CW.Passthrough](VARpassThrough=count, VARwaitFor=setParameterByName)  # Forces a sequential order of execution. The node wired into the output of the Passthrough node will be executed *after* the node wired into the waitFor input (e.g. important for some Revit operations). The value of the passThrough input will be passed on to the node wired into the output port of the Passthrough node.
code_block_3 = CodeBlock(startCharacter=VARstartCharacter, total=passthrough) { startCharacter..#total..1; 9000..#total..1; }
string_from_object_2 = FromObject(obj=code_block_3.out1)
setParameterByName_2 = Element.SetParameterByName(element=rh_select_grids_by_curve, parameterName=string, value=string_from_object_2)
string_from_object_3 = FromObject(obj=code_block_3.out0)
setParameterByName_3 = Element.SetParameterByName(element=setParameterByName_2, parameterName=string, value=string_from_object_3)
