# Dynamo custom node RH.Select Grids By Curve.dyf (Dynamo 2.1.0.7500)
# category: Synthesize.Packages.Rhythm.Revit.Selection
# This will select Revit grids by the input Revit curve,

VARmodelCurve = Input(VARmodelCurve: var[]..[])
geometry = Element.Geometry(element=VARmodelCurve)
categories = Categories("OST_Grids")  # graph input
all_elements_of_category = ElementsOfCategory(Category=categories)
curve = Grid.Curve(grid=all_elements_of_category)
code_block = CodeBlock(curve=curve) { curve[0]; }
startPoint = Curve.StartPoint(curve=code_block)
byOriginNormal = Plane.ByOriginNormal(origin=startPoint)
pullOntoPlane = Curve.PullOntoPlane(curve=geometry, plane=byOriginNormal, lacing=Longest)
intersectAll = Geometry.IntersectAll(geometry=pullOntoPlane, others=curve, lacing=Longest)
flatten = List.Flatten(list=intersectAll)
code_block_2 = CodeBlock { false; }
clean = List.Clean(list=flatten, preserveIndices=code_block_2)
splitByPoints = Curve.SplitByPoints(curve=pullOntoPlane, points=clean)
endPoint = Curve.EndPoint(curve=splitByPoints)
flatten_2 = List.Flatten(list=endPoint)
doesIntersect = Geometry.DoesIntersect(other=curve)  # unwired: geometry
map = List.Map(list=flatten_2, f_x=doesIntersect)
filterByBoolMask = List.FilterByBoolMask(list=all_elements_of_category)  # unwired: mask
map_2 = List.Map(list=map, f_x=filterByBoolMask.in)
flatten_3 = List.Flatten(list=map_2)
uniqueItems = List.UniqueItems(list=flatten_3)
VARgrids = Output(uniqueItems)
