# Dynamo custom node Random Letters.dyf (Dynamo 2.1.0.7500)
# category: Synthesize.Automate.List
# Random Letters

VARNumberofLetters = Input(VARNumberofLetters: var[]..[])
python_script = Python(IN[0]=VARNumberofLetters)
# ---------- python_script.python (18 lines) ----------
import clr
clr.AddReference('ProtoGeometry')
from Autodesk.DesignScript.Geometry import *
#The inputs to this node will be stored as a list in the IN variables.
dataEnteringNode = IN

import sys
sys.path.append(r'C:\Program Files (x86)\IronPython 2.7\DLLs')
sys.path.append(r'C:\Program Files (x86)\IronPython 2.7\Lib')
import random
import string
def random_char(y):
       return ''.join(random.choice(string.ascii_letters) for x in range(y))

number = IN[0]

#Assign your output to the OUT variable.
OUT = random_char(number)
# ----------------------------------------
VAROut = Output(python_script)
