# Dynamo custom node Randomize Parameters.dyf (Dynamo 2.3.2.15696)
# category: Synthesize.Automate.Parameter
# Randomize Parameters
# packages: Synthesize toolkit 12.7.2

VARIsTypeParameters = Input(VARIsTypeParameters: var[]..[])
VARElementstoWorkon = Input(VARElementstoWorkon: var[]..[])
elementType = Element.ElementType(element=VARElementstoWorkon)
uniqueItems = List.UniqueItems(list=elementType)
scopeIf = Custom[CW.ScopeIf+](VARtest=VARIsTypeParameters, VARtrue=uniqueItems, VARfalse=VARElementstoWorkon)  # package Synthesize toolkit; A (hopefully) more robust implementation of ScopeIf. Tests a single boolean and returns a value accordingly.
code_block = CodeBlock { false; }
clean = List.Clean(list=scopeIf, preserveIndices=code_block)
flatten = List.Flatten(list=clean)
VARListofParameterstoRandomize = Input(VARListofParameterstoRandomize: var[]..[])
VARMinimumValue = Input(VARMinimumValue: var[]..[])
VARMaximumValue = Input(VARMaximumValue: var[]..[])
VARRounding = Input(VARRounding: var[]..[])
VARIntegernumbersofRandomizing = Input(VARIntegernumbersofRandomizing: var[]..[])
VARAdditive = Input(VARAdditive: var[]..[])
VARProceed = Input(VARProceed: var[]..[])
python_script = Python(IN[0]=flatten, IN[1]=VARListofParameterstoRandomize, IN[2]=VARMinimumValue, IN[3]=VARMaximumValue, IN[4]=VARRounding, IN[5]=VARIntegernumbersofRandomizing, IN[6]=VARAdditive, IN[7]=VARProceed)
# ---------- python_script.python (152 lines) ----------
# Created By Karam Baki : karam@aecedx.com
# Enable Python support and load DesignScript library
# IMPORTANT : ALL DYNAMO DESIGN SCRIPT NODES ARE AS (dg)
import clr
clr.AddReference('ProtoGeometry')
from Autodesk.DesignScript import Geometry as dg

# EXTENSION Enable ToDSType
clr.AddReference('RevitNodes')
import Revit
clr.ImportExtensions(Revit.Elements)

# Enable Revit Elements
from Revit.Elements import *

# EXTENSION Enable Geometry Conversion Methods
clr.ImportExtensions(Revit.GeometryConversion)

# Enable Revit API
clr.AddReference('RevitAPI')
from Autodesk.Revit.DB import *

# Enable DocumentManager and TransactionManager
clr.AddReference('RevitServices')
from RevitServices.Persistence import DocumentManager
from RevitServices.Transactions import TransactionManager

# Enable ICollection List Translate
clr.AddReference("System")
import System.Collections.Generic
from System.Collections.Generic import List

import sys
sys.path.append(r'C:\Program Files (x86)\IronPython 2.7\DLLs')
sys.path.append(r'C:\Program Files (x86)\IronPython 2.7\Lib')
import random
import math

def tolist(obj1):
	if hasattr(obj1,'__iter__'): return obj1
	else: return [obj1]
	
dataEnteringNode = IN
# Use UnwrapElement(IN[0]) When Translating From Dynamo to Revit
elems=UnwrapElement(tolist(IN[0]))
params=UnwrapElement(tolist(IN[1]))
min=IN[2]
max=IN[3]
rounding=IN[4]
integer=IN[5]
additive=IN[6]
proceed=IN[7]

if integer == True:
	min = int(math.floor(min))
	max = int(math.floor(max))

loweredparams = []
for p in params:
	loweredparams.append(p.lower())

def randomvalue(min,max,rounding,integer):
	if integer == True:
		val = random.randint(min,max)
	else:
		val = round(random.uniform(min, max)/rounding)*rounding
	return val

# Choose The Current Document
doc = DocumentManager.Instance.CurrentDBDocument
uidoc = DocumentManager.Instance.CurrentUIApplication.ActiveUIDocument
uiapp = DocumentManager.Instance.CurrentUIApplication
app = uiapp.Application

# Create Empty List
result = []
values = []

if int(DocumentManager.Instance.CurrentUIApplication.Application.VersionNumber) < 2022:
	oldrevit = True
else:
	oldrevit = False

# Start a Transaction with Current Document (doc)
TransactionManager.Instance.EnsureInTransaction(doc)

for each in elems:
	eachparams = each.GetOrderedParameters()
	tmp = []
	for e in eachparams:
		pname = e.Definition.Name.lower()
		storagetype = str(e.StorageType)
		if pname in loweredparams:
			try:
				if additive == True:
					if storagetype == "Integer":
						existed = e.AsInteger()
						newvalue = existed + (randomvalue(min,max,rounding,integer))
					else:
						existed = e.AsDouble()
						if oldrevit:
							unit_type = e.Definition.UnitType
							formatoptions = doc.GetUnits().GetFormatOptions(unit_type)
							dispunits = formatoptions.DisplayUnits
							toconvert = randomvalue(min,max,rounding,integer)
							added = UnitUtils.ConvertToInternalUnits(toconvert,dispunits)
							newvalue = existed + added
							report = toconvert + UnitUtils.ConvertFromInternalUnits(existed,dispunits)
						else:
							unit_type = e.Definition.GetDataType()
							toconvert = randomvalue(min,max,rounding,integer)
							added = UnitUtils.ConvertToInternalUnits(toconvert,doc.GetUnits().GetFormatOptions(unit_type).GetUnitTypeId())
							newvalue = existed + added
							report = toconvert + UnitUtils.ConvertFromInternalUnits(existed,doc.GetUnits().GetFormatOptions(unit_type).GetUnitTypeId())
					if proceed == True:
						result.append(e.Set(newvalue))
					tmp.append(report)
				else:
					if storagetype == "Integer":
						newvalue = randomvalue(min,max,rounding,integer)
					else:
						if oldrevit:
							unit_type = e.Definition.UnitType
							formatoptions = doc.GetUnits().GetFormatOptions(unit_type)
							dispunits = formatoptions.DisplayUnits
							report = randomvalue(min,max,rounding,integer)
							newvalue = UnitUtils.ConvertToInternalUnits(report,dispunits)
						else:
							unit_type = e.Definition.GetDataType()
							report = randomvalue(min,max,rounding,integer)
							newvalue = UnitUtils.ConvertToInternalUnits(report,doc.GetUnits().GetFormatOptions(unit_type).GetUnitTypeId())
					if proceed == True:
						result.append(e.Set(newvalue))
					if storagetype == "Integer":
						tmp.append(newvalue)
					else:
						tmp.append(report)
			except:
				result.append(False)
				tmp.append("ERROR")
	if len(tmp) == 1:
		values.append(tmp[0])
	elif len(tmp) == 0:
		values.append("ERROR")
	else:
		values.append(tmp)

# End the Transaction with Current Document ()
TransactionManager.Instance.TransactionTaskDone()

# Assign your output to the OUT variable.
OUT = values
# ----------------------------------------
VARValuesGenerated = Output(python_script)
