# Dynamo custom node ReFusion IT Import.dyf (Dynamo 2.1.0.7500)
# category: Synthesize.Fusion360
# This Node Fixes the orientation of the SAT file from Fusion 360 To Revit (Karam Baki)

VARFusionSATFilePath = Input(VARFusionSATFilePath: var[]..[])
importFromSAT = Geometry.ImportFromSAT(file=VARFusionSATFilePath)
number = DoubleInput(1)  # graph input
byCoordinates = Vector.ByCoordinates(y=number, z=number)
byOriginNormal = Plane.ByOriginNormal(normal=byCoordinates)
number_2 = DoubleInput(180)  # graph input
rotate = Geometry.Rotate(geometry=importFromSAT, basePlane=byOriginNormal, degrees=number_2)
VARGeometry = Output(rotate)
