# Dynamo custom node Recurring Group Elements Fetch.dyf (Dynamo 2.1.0.7500)
# category: Synthesize.Automate.Select
# Recurring Group Elements Fetch

VARElements = Input(VARElements: var[]..[])
VARFetch = Input(VARFetch: var[]..[])
python_script = Python(IN[0]=VARElements, IN[1]=VARFetch)
# ---------- python_script.python (81 lines) ----------
# Enable Python support and load DesignScript library
# IMPORTANT : ALL DYNAMO DESIGN SCRIPT NODES ARE AS (dg)
import clr
clr.AddReference('ProtoGeometry')
from Autodesk.DesignScript import Geometry as dg

# EXTENSION Enable ToDSType
clr.AddReference('RevitNodes')
import Revit
clr.ImportExtensions(Revit.Elements)

# Enable Revit Elements
from Revit.Elements import *

# EXTENSION Enable Geometry Conversion Methods
clr.ImportExtensions(Revit.GeometryConversion)

# Enable Revit API
clr.AddReference('RevitAPI')
from Autodesk.Revit.DB import *

# Enable DocumentManager and TransactionManager
clr.AddReference('RevitServices')
from RevitServices.Persistence import DocumentManager
from RevitServices.Transactions import TransactionManager

# Enable ICollection List Translate
clr.AddReference("System")
import System.Collections.Generic
from System.Collections.Generic import List

groups = UnwrapElement(IN[0])
fetch = IN[1]

def getmems(elem):
	result = []
	if hasattr(elem, 'GroupType'):
		for member in elem.GetMemberIds():
			result.append(elem.Document.GetElement(member))
	if len(result) == 0:
		return elem
	else:
		return result

def flatten(x):
    result = []
    for el in x:
        if hasattr(el, "__iter__") and not isinstance(el, basestring):
            result.extend(flatten(el))
        else:
            result.append(el)
    return result

def gettype(allelems):
	result = []
	for e in allelems:
		try:
			result.append(e.GetType())
		except:
			result.append(e)
	return result

def keeptrying(allelems):
	alltypes = gettype(flatten(allelems))
	allelems = flatten(allelems)
	result = []
	for e in allelems:
		result.append(getmems(e))
	return result

if fetch == True:
	alltypes = gettype(groups)
	allelems = flatten(groups)
	while Group in alltypes:
		allelems = flatten(keeptrying(flatten(allelems)))
		alltypes = gettype(allelems)
	result = list(set(allelems))
else:
	result = groups

OUT = result
# ----------------------------------------
VARElements_2 = Output(python_script)  # "VARElements"
