# Dynamo custom node Reference Plane Perpendicular On Face.dyf (Dynamo 2.1.0.7500)
# category: Synthesize.Automate.Reference Plane
# Reference Plane Perpendicular On Face

VARFaces = Input(VARFaces: var[]..[])
flatten = List.Flatten(list=VARFaces)
code_block = CodeBlock { false; }
clean = List.Clean(list=flatten, preserveIndices=code_block)
flatten_2 = List.Flatten(list=clean@L2)
area = Surface.Area(surface=flatten_2)
code_block_2 = CodeBlock { ""; " "; 0; }
gt = area > code_block_2.out2
filterByBoolMask = List.FilterByBoolMask(list=flatten_2, mask=gt)
flatten_3 = List.Flatten(list=filterByBoolMask.in)
empty = List.Empty()
VARFlipReferencePlanesSide = Input(VARFlipReferencePlanesSide: var[]..[])
flatten_4 = List.Flatten(list=filterByBoolMask.in)
byGeometry = BoundingBox.ByGeometry(geom=flatten_4, lacing=Longest)
toCuboid = BoundingBox.ToCuboid(boundingBox=byGeometry)
code_block_3 = CodeBlock { 1; }
chop = List.Chop(list=toCuboid, lengths=code_block_3)
volume = Solid.Volume(lacing=Longest)  # unwired: solid
map = List.Map(list=chop, f_x=volume)
flatten_5 = List.Flatten(list=map)
code_block_4 = CodeBlock { 0; }
eq = flatten_5 == code_block_4
filterByBoolMask_2 = List.FilterByBoolMask(list=flatten_4, mask=eq)
code_block_5 = CodeBlock { 1; }
thicken = Surface.Thicken(surface=filterByBoolMask_2.in, thickness=code_block_5)
mergeByBoolMask = Custom[SP.List.MergeByBoolMask](VARIn=thicken, VAROut=filterByBoolMask_2.out, VARmask=eq)  # Merge two lists by a boolean mask list. The true count in the mask should be the same as the length of the true list and vice versa for the false list.
isNull = Object.IsNull(obj=flatten_5)
filterByBoolMask_3 = List.FilterByBoolMask(list=mergeByBoolMask, mask=isNull)
code_block_6 = CodeBlock { 1; }
thicken_2 = Surface.Thicken(surface=filterByBoolMask_3.in, thickness=code_block_6)
mergeByBoolMask_2 = Custom[SP.List.MergeByBoolMask](VARIn=thicken_2, VAROut=filterByBoolMask_3.out, VARmask=isNull)
byGeometry_2 = BoundingBox.ByGeometry(geom=mergeByBoolMask_2, lacing=Longest)
toCuboid_2 = BoundingBox.ToCuboid(boundingBox=byGeometry_2)
centroid = Solid.Centroid(solid=toCuboid_2)
XYZ = Custom[LF.Point.XYZ](VARpoint=centroid)  # Get the X, Y, and Z components of a Point
VARReferencePlanesOffset = Input(VARReferencePlanesOffset: var[]..[])
code_block_7 = CodeBlock { 0; -1; }
gt_2 = VARReferencePlanesOffset > code_block_7.out0
mul = VARReferencePlanesOffset * code_block_7.out1
scopeIf = Custom[CW.ScopeIf+](VARtest=gt_2, VARtrue=mul, VARfalse=VARReferencePlanesOffset)  # A (hopefully) more robust implementation of ScopeIf. Tests a single boolean and returns a value accordingly.
code_block_8 = CodeBlock { 0; -1; }
lt = VARReferencePlanesOffset < code_block_8.out0
mul_2 = VARReferencePlanesOffset * code_block_8.out1
scopeIf_2 = Custom[CW.ScopeIf+](VARtest=lt, VARtrue=mul_2, VARfalse=VARReferencePlanesOffset)
scopeIf_3 = Custom[CW.ScopeIf+](VARtest=VARFlipReferencePlanesSide, VARtrue=scopeIf, VARfalse=scopeIf_2)
code_block_9 = CodeBlock { 2; }
div = scopeIf_3 / code_block_9
sub = XYZ.VARZ - div
byCoordinates = Point.ByCoordinates(x=XYZ.VARX, y=XYZ.VARY, z=sub)
byOrigin = CoordinateSystem.ByOrigin(origin=byCoordinates)
code_block_10 = CodeBlock { 0.5; }
pointAtParameter = Surface.PointAtParameter(surface=flatten_4, u=code_block_10, v=code_block_10)
normalAtPoint = Surface.NormalAtPoint(surface=flatten_4, point=pointAtParameter)
byOriginNormal = Plane.ByOriginNormal(origin=pointAtParameter, normal=normalAtPoint)
byPlane = CoordinateSystem.ByPlane(plane=byOriginNormal)
transform = CoordinateSystem.Transform(coordinateSystem=byOrigin, fromCoordinateSystem=byOrigin, contextCoordinateSystem=byPlane)
ZAxis = CoordinateSystem.ZAxis(coordinateSystem=transform)
translate = CoordinateSystem.Translate(coordinateSystem=transform, direction=ZAxis, distance=div)
join = List.Join()  # unwired: list0, list1
length = Cuboid.Length(cuboid=toCuboid_2)
width = Cuboid.Width(cuboid=toCuboid_2)
combine = List.Combine(comb=join, list1=length, list2=width)
maximumItem = List.MaximumItem(list=combine)
eq_2 = maximumItem == combine
filterByBoolMask_4 = List.FilterByBoolMask(list=combine, mask=eq_2)
firstItem = List.FirstItem(list=filterByBoolMask_4.in@L2)
byLengths = Cuboid.ByLengths(cs=translate, width=firstItem, length=firstItem, height=scopeIf_3)
explode = Geometry.Explode(geometry=byLengths)
perimeterCurves = Surface.PerimeterCurves(surface=explode)
startPoint = Curve.StartPoint(curve=perimeterCurves)
flatten_6 = List.Flatten(list=startPoint@L3)
pruneDuplicates = Point.PruneDuplicates(points=flatten_6)
code_block_11 = CodeBlock { 4; -4; }
scopeIf_4 = Custom[CW.ScopeIf+](VARtest=VARFlipReferencePlanesSide, VARtrue=code_block_11.out1, VARfalse=code_block_11.out0)
takeItems = List.TakeItems(list=pruneDuplicates@L2, amount=scopeIf_4)
reverse = List.Reverse(list=takeItems@L2)
scopeIf_5 = Custom[CW.ScopeIf+](VARtest=VARFlipReferencePlanesSide, VARtrue=reverse, VARfalse=takeItems)
byPerimeterPoints = Surface.ByPerimeterPoints(points=scopeIf_5)
code_block_12 = CodeBlock { 0.5; 1; 0; }
pointAtParameter_2 = Surface.PointAtParameter(surface=byPerimeterPoints, u=code_block_12.out0, v=code_block_12.out2)
pointAtParameter_3 = Surface.PointAtParameter(surface=byPerimeterPoints, u=code_block_12.out0, v=code_block_12.out1)
byStartPointEndPoint = Line.ByStartPointEndPoint(startPoint=pointAtParameter_2, endPoint=pointAtParameter_3)
code_block_13 = CodeBlock { 0.5; }
pointAtParameter_4 = Curve.PointAtParameter(curve=byStartPointEndPoint, param=code_block_13)
normalAtPoint_2 = Surface.NormalAtPoint(surface=byPerimeterPoints, point=pointAtParameter_4)
planeAtParameter = Curve.PlaneAtParameter(curve=byStartPointEndPoint, param=code_block_13)
code_block_14 = CodeBlock { 90; }
rotate = Vector.Rotate(vector=normalAtPoint_2, plane=planeAtParameter, degrees=code_block_14)
python_script = Python(IN[0]=pointAtParameter_2, IN[1]=pointAtParameter_3, IN[2]=rotate)
# ---------- python_script.python (44 lines) ----------
# Enable Python support and load DesignScript library
# IMPORTANT : ALL DYNAMO DESIGN SCRIPT NODES ARE AS (dg)
import clr
clr.AddReference('ProtoGeometry')
from Autodesk.DesignScript import Geometry as dg

# EXTENSION Enable ToDSType
clr.AddReference('RevitNodes')
import Revit
clr.ImportExtensions(Revit.Elements)

# EXTENSION Enable Geometry Conversion Methods
clr.ImportExtensions(Revit.GeometryConversion)

# Enable DocumentManager and TransactionManager
clr.AddReference('RevitServices')
from RevitServices.Persistence import DocumentManager
from RevitServices.Transactions import TransactionManager


# Choose The Current Document
doc = DocumentManager.Instance.CurrentDBDocument
uidoc = DocumentManager.Instance.CurrentUIApplication.ActiveUIDocument
uiapp = DocumentManager.Instance.CurrentUIApplication
app = uiapp.Application


#unwrap all elements to use with API
xyzstart = UnwrapElement(IN[0])
xyzend = UnwrapElement(IN[1])
xyzvec = UnwrapElement(IN[2])


TransactionManager.Instance.EnsureInTransaction(doc)
planes = []
count = 0
for each in xyzvec:

	planes.append(doc.FamilyCreate.NewReferencePlane(xyzstart[count].ToXyz(), xyzend[count].ToXyz(), each.ToXyz(), doc.ActiveView))
	count = count + 1
TransactionManager.Instance.TransactionTaskDone()

#Assign your output to the OUT variable
OUT = planes
# ----------------------------------------
code_block_15 = CodeBlock { "Name"; }
VARReferencePlaneNamePrefix = Input(VARReferencePlaneNamePrefix: var[]..[])
code_block_16 = CodeBlock { " "; }
code_block_17 = CodeBlock { "[0-9]+"; }
element_types = ElementTypes("ReferencePlane")  # graph input
all_elements_of_type = ElementsOfType(element_type=element_types)
getParameterValueByName = Element.GetParameterValueByName(element=all_elements_of_type, parameterName=code_block_15)
turnIntoList = Custom[CW.TurnIntoList](VARunknownItem=VARReferencePlaneNamePrefix)  # Turns an element (or a nested list) into a flat list
contains = Custom[AL.String.Contains](VARStringList=getParameterValueByName, VARFilterList=turnIntoList)  # This node takes a list of strings and checks if any string contains a matching string from filter input.
filterByBoolMask_5 = List.FilterByBoolMask(list=getParameterValueByName, mask=contains)
findRegularExpression = Custom[CW.String.FindRegularExpression](VARRegEx=code_block_17, VARstr=filterByBoolMask_5.in)  # Returns all occurences of a regular expression within a string (or list of strings). The syntax for regular expressions is explained at http://ironpython-test.readthedocs.org/en/latest/howto/regex.html
flatten_7 = List.Flatten(list=findRegularExpression)
toNumber = String.ToNumber(str=flatten_7)
uniqueItems = List.UniqueItems(list=toNumber)
sort = List.Sort(list=uniqueItems)
list_lastitem_fixer = Custom[List.LastItem Fixer](VARlist=sort)  # List.LastItem Fixer
code_block_18 = CodeBlock { 1; }
add = list_lastitem_fixer + code_block_18
isNull_2 = Object.IsNull(obj=add)
code_block_19 = CodeBlock { 1; }
scopeIf_6 = Custom[CW.ScopeIf+](VARtest=isNull_2, VARtrue=code_block_19, VARfalse=add)
count = List.Count(list=python_script)
code_block_20 = CodeBlock { 1; }
sequence = Sequence(start=scopeIf_6, amount=count, step=code_block_20, lacing=Longest)
string_from_object = FromObject(obj=sequence)
code_block_21 = CodeBlock(a=VARReferencePlaneNamePrefix, b=code_block_16, c=string_from_object) { a+b+c; }
setParameterByName = Element.SetParameterByName(element=python_script, parameterName=code_block_15, value=code_block_21)
VARElement = Output(setParameterByName)
