# Dynamo custom node ReferencePlane.ByStartPointEndPoint Fixer.dyf (Dynamo 2.1.0.7500)
# category: Synthesize.Fixers
# Fixer Node to Hide Error

VARPoint = Input(VARPoint: var[]..[])
VARPoint_2 = Input(VARPoint: var[]..[])
byStartPointEndPoint = ReferencePlane.ByStartPointEndPoint(start=VARPoint, end=VARPoint_2)
VARReferencePlane = Output(byStartPointEndPoint)
