# Dynamo custom node Revit Extrusion By Curve and Sketchplane.dyf (Dynamo 2.1.0.7500)
# category: Synthesize.Automate.Family
# Revit Extrusion By Curve and Sketchplane

VARCurves = Input(VARCurves: var[]..[])
VARSketchPlane = Input(VARSketchPlane: var[]..[])
python_script = Python(IN[0]=VARCurves, IN[1]=VARSketchPlane)
# ---------- python_script.python (40 lines) ----------
from System.Collections.Generic import *

import clr
# Import RevitAPI
clr.AddReference("RevitAPI")
import Autodesk
from Autodesk.Revit.DB import *
from Autodesk.Revit.Creation.FamilyItemFactory import NewExtrusion

clr.AddReference("RevitServices")
import RevitServices
from RevitServices.Persistence import DocumentManager
from RevitServices.Transactions import TransactionManager

clr.AddReference("RevitNodes")
import Revit
clr.ImportExtensions(Revit.Elements)
from Revit.Elements import *
clr.ImportExtensions(Revit.GeometryConversion)

doc = DocumentManager.Instance.CurrentDBDocument

lines = IN[0]
spls = UnwrapElement(IN[1])

rvtLines = [i.ToRevitType() for i in lines]

curveArrArray = CurveArrArray()
curveArray1 = CurveArray()

for i in rvtLines:
	curveArray1.Append(i)
	
curveArrArray.Append(curveArray1)

TransactionManager.Instance.EnsureInTransaction(doc)
solid1 = doc.FamilyCreate.NewExtrusion(True, curveArrArray, spls, 1.0)
TransactionManager.Instance.TransactionTaskDone()

OUT = solid1
# ----------------------------------------
VARExtrusions = Output(python_script)
