# Dynamo custom node Revolve Direct.dyf (Dynamo 2.1.0.7500)
# category: Synthesize.Automate.Surface
# Revolve Direct

VARGetSolids = Input(VARGetSolids: var[]..[])
VARProfiles = Input(VARProfiles: var[]..[])
flatten = List.Flatten(list=VARProfiles)
as_polycurve_bycurves = Custom[AS.[&] PolyCurve.ByCurves](VARcurves=flatten)  # Create polycurves from an unordered list of curves.
code_block = CodeBlock { null; false; }
scopeIf = Custom[CW.ScopeIf+](VARtest=VARGetSolids, VARtrue=as_polycurve_bycurves.VARpolyCurve, VARfalse=code_block.out0)  # A (hopefully) more robust implementation of ScopeIf. Tests a single boolean and returns a value accordingly.
clean = List.Clean(list=scopeIf, preserveIndices=code_block.out1)
VARAxis = Input(VARAxis: var[]..[])
flatten_2 = List.Flatten(list=VARAxis)
startPoint = Curve.StartPoint(curve=flatten_2)
endPoint = Curve.EndPoint(curve=flatten_2)
byTwoPoints = Vector.ByTwoPoints(start=startPoint, end=endPoint)
VARstartAngle = Input(VARstartAngle: double)
VARsweepAngle = Input(VARsweepAngle: double)
byRevolve = Solid.ByRevolve(profile=clean, axisOrigin=startPoint, axisDirection=byTwoPoints, startAngle=VARstartAngle, sweepAngle=VARsweepAngle, lacing=CrossProduct)
flatten_3 = List.Flatten(list=byRevolve@L4)
firstItem = List.FirstItem(list=flatten_3@L2)
scopeIf_2 = Custom[CW.ScopeIf+](VARtest=VARGetSolids, VARtrue=code_block.out0, VARfalse=as_polycurve_bycurves.VARpolyCurve)
clean_2 = List.Clean(list=scopeIf_2, preserveIndices=code_block.out1)
byRevolve_2 = Surface.ByRevolve(profile=clean_2, axisOrigin=startPoint, axisDirection=byTwoPoints, startAngle=VARstartAngle, sweepAngle=VARsweepAngle, lacing=CrossProduct)
flatten_4 = List.Flatten(list=byRevolve_2@L4)
firstItem_2 = List.FirstItem(list=flatten_4@L2)
create = List.Create(item0=firstItem, item1=firstItem_2)
code_block_2 = CodeBlock { false; }
clean_3 = List.Clean(list=create, preserveIndices=code_block_2)
flatten_5 = List.Flatten(list=clean_3)
VARitem = Output(flatten_5)
