# Dynamo custom node SP.AutoSATGeometry.ByElements.dyf (Dynamo 2.1.0.7500)
# category: Synthesize.Packages.Springs.Revit.FamilyInstance
# You must provide a valid family template path that will be used for all input geometry objects. The project units(and not the templates) will be used to determine the size of the output geometry.
# The provided category will be used only if the family template supports it. If not, the default template category will be used instead.
# Likewise, the family material(provided as a string) will be set only if a material with that name exists in the template. If not, the default material will be used instead ("By Category").
# For void cuts, the material settings will be ignored.
# The Subcategory name is an optional input. If you'd like to skip assigning a Subcategory to any new instance, simply use null.
# The node expects a unique family name for each geometry object. The rest of the input lists will be processed as if the node lacing is set to longest.

VARgeometry = Input(VARgeometry: var[])
VARPositionSystemFalseIsInstanceOriginTr = Input(VARPositionSystemFalseIsInstanceOriginTrueRelativeToProjectOrigin: bool[] = false)
python_script = Python(IN[0]=VARgeometry, IN[1]=VARPositionSystemFalseIsInstanceOriginTr)
# ---------- python_script.python (168 lines) ----------
#Copyright(c) 2016, Dimitar Venkov
# @5devene, dimitar.ven@gmail.com
# Modified & Improved By Karam Baki, karam@aecedx.com
import clr
import System
from System.Collections.Generic import *

from itertools import repeat

pf_path = System.Environment.GetFolderPath(System.Environment.SpecialFolder.ProgramFilesX86)
import sys
sys.path.append('%s\IronPython 2.7\Lib' %pf_path)
import traceback

clr.AddReference('ProtoGeometry')
from Autodesk.DesignScript.Geometry import *
from Autodesk.DesignScript.Geometry import Point as DynPoint
from Autodesk.DesignScript.Geometry import Line as DynLine
from Autodesk.DesignScript.Geometry import Curve as DynCurve

clr.AddReference('RevitServices')
import RevitServices
from RevitServices.Persistence import DocumentManager
from RevitServices.Transactions import TransactionManager
doc = DocumentManager.Instance.CurrentDBDocument

clr.AddReference('RevitAPI')
from Autodesk.Revit.DB import *
from Autodesk.Revit.DB.Structure import StructuralType

clr.AddReference('RevitNodes')
import Revit
clr.ImportExtensions(Revit.Elements)
clr.ImportExtensions(Revit.GeometryConversion)

def tolist(obj1):
	if hasattr(obj1,'__iter__'): return obj1
	else: return [obj1]

def output1(l1):
	if len(l1) == 1: return l1[0]
	else: return l1

def PadLists(lists):
	len1 = len(lists[0])
	for i in xrange(1,len(lists)):
		len2 = len(lists[i])
		if len2 == len1 : continue
		elif len2 > len1: lists[i] = lists[i][:len1]
		else : lists[i].extend(repeat(lists[i][-1],len1 - len2))
	return lists

class FamOpt1(IFamilyLoadOptions):
	def __init__(self):
		pass
	def OnFamilyFound(self,familyInUse, overwriteParameterValues):
		return True
	def OnSharedFamilyFound(self,familyInUse, source, overwriteParameterValues):
		return True

geom = UnwrapElement(IN[0])
if geom != None:
	geom = tolist(geom)
else:
	pass
positionSystem = tolist(IN[1])

if int(DocumentManager.Instance.CurrentUIApplication.Application.VersionNumber) < 2021:
	units = doc.GetUnits().GetFormatOptions(UnitType.UT_Length).DisplayUnits
	factor = UnitUtils.ConvertToInternalUnits(1,units)
else:
	factor = UnitUtils.ConvertToInternalUnits(1,doc.GetUnits().GetFormatOptions(SpecTypeId.Length).GetUnitTypeId())
acceptable_views = ('ThreeD', 'FloorPlan', 'EngineeringPlan', 'CeilingPlan', 'Elevation', 'Section')
origin = XYZ.Zero
str_typ = StructuralType.NonStructural
t1 = TransactionManager.Instance
temp_path = System.IO.Path.GetTempPath()
invalid_chars = System.IO.Path.GetInvalidFileNameChars()
satOpt = SATImportOptions()
satOpt.Placement = ImportPlacement.Origin
satOpt.Unit = ImportUnit.Foot
opt1 = Options()
opt1.ComputeReferences = True
SaveAsOpt = SaveAsOptions()
SaveAsOpt.OverwriteExistingFile = True

def NewForm_background(s1, positionSystem1):
	try:
		if mat1 == None or mat1 == "":
			enable_mat = False
		else:
			enable_mat = True
			
		if subcat1 == None or subcat1 == "":
			enable_subcat = False
		else:
			enable_subcat = True

		if any( (c in name1 for c in invalid_chars) ):
			raise Exception('Family name contains invalid characters')
		TransactionManager.ForceCloseTransaction(t1)
		famdoc = doc.Application.NewFamilyDocument(fam_path)
		sat_path = '%s%s.sat' % (temp_path, name1)
		if factor != 1:
		    tlist = []
		    for each in s1:
		        tlist.append(each.Scale(factor))
			s1 = tlist
		if positionSystem1 == False:
			bbox = BoundingBox.ByGeometry(s1)
			Minploc = bbox.MinPoint
			Maxploc = bbox.MaxPoint
			MAX_X = Maxploc.X
			MAX_Y = Maxploc.Y
			min_Z = Minploc.Z
			NEWMAX = DynPoint.ByCoordinates(MAX_X,MAX_Y,min_Z)
			linebet = DynLine.ByStartPointEndPoint(Minploc,NEWMAX)
			locpoint = DynCurve.PointAtParameter(linebet,0.5)
			vec1 = Vector.ByTwoPoints(locpoint, DynPoint.Origin())
			tlist = []
			for each in s1:
				tlist.append(each.Translate(vec1))
		s1 = tlist
		sat1 = Geometry.ExportToSAT(s1, sat_path)
		view_fec = FilteredElementCollector(famdoc).OfClass(View)
		view1 = None
		for v in view_fec:
			if str(v.ViewType) in acceptable_views and not v.IsTemplate:
				view1 = v
				break
		t1.EnsureInTransaction(famdoc)
		satId = famdoc.Import(sat1, satOpt, view1)
		el1 = famdoc.GetElement(satId)
		geom1 = el1.get_Geometry(opt1)
		enum = geom1.GetEnumerator()
		enum.MoveNext()
		geom2 = enum.Current.GetInstanceGeometry()
		enum2 = geom2.GetEnumerator()
		enum2.MoveNext()
		s1 = enum2.Current
		famdoc.Delete(satId)
		System.IO.File.Delete(sat_path)
		save_path = '%s%s.rfa' % (temp_path, name1)
		#for seach in s1:
		s2 = FreeFormElement.Create(famdoc,s1)
		TransactionManager.ForceCloseTransaction(t1)	
	except:
		return traceback.format_exc(),''
result = []

if geom == None or len(geom) == 0:
	OUT = None
else:
	if len(geom) == len(names):
		glist = []
		for each in geom:
			glist.append([each])
		geom = glist
		padded = PadLists([geom, positionSystem])
		p_positionSystem = padded[1]
		return1 = map(NewForm_background, geom, names, p_positionSystem)
		result = output1([i[0] for i in return1]), output1([i[1] for i in return1])
	else :
		result = NewForm_background(geom, names[0], positionSystem[0])
	OUT = result
	satOpt.Dispose()
	opt1.Dispose()
	SaveAsOpt.Dispose()
# ----------------------------------------
code_block = CodeBlock(res=python_script) { res[0]; res[1]; }
VARinstance = Output(code_block.out0)
VARfamily = Output(code_block.out1)
