# Dynamo custom node SP.CurveLoop.Simplify With Ratio.dyf (Dynamo 2.1.0.7500)
# category: Synthesize.Packages.Springs.Geometry
# Attempts to simplify an open or a closed curve loop by connecting straight separate line segments into a single line.

VARcurveLoop = Input(VARcurveLoop: var[])
VARratio = Input(VARratio: var[]..[])
code_block = CodeBlock(curves=VARcurveLoop, rat=VARratio)
# ---------- code_block.designscript (82 lines) ----------
def _isLine(c){
return = Math.Abs(c.Length - c.StartPoint.
  DistanceTo(c.EndPoint) ) <= 0.0001;
};

def _isParal(a, b, r){
v1 = Vector.ByTwoPoints(a.StartPoint,
  a.EndPoint).Normalized();
v2 = Vector.ByTwoPoints(b.StartPoint,
  b.EndPoint).Normalized();
return = Math.Abs(v1.Dot(v2) ) >= r;
};

def _shiftIndices(x:var[], i){
return = DSCore.List.ShiftIndices(x, i);
};

curves;
rat;
simplified = [Imperative]{
i = 0;
j = 0;
len1 = Count(curves) - 1;
outp = [];
isClosed = curves[-1].EndPoint.
  IsAlmostEqualTo(curves[0].StartPoint);

//find a corner;
if (isClosed)
{
	shift = 0;
	for (k in GetKeys(curves) )
	{
		if (!_isParal(curves[k-1], curves[k], rat) )
		{
			break;
		}
		shift = shift - 1;
	}
	curves = _shiftIndices(curves, shift);
}

//skip initial non lines
while (!_isLine(curves[i]) && i < len1)
	{
		outp[j] = curves[i];
		j = j + 1;
		i = i + 1;
	}

while (i < len1)
{
	sP = curves[i].StartPoint;
	eP = null;
	v1 = cVec(curves[i]);
	v2 = cVec(curves[i+1]);
	while (_isLine(curves[i+1]) &&
	  _isParal(curves[i], curves[i+1], rat) )
	{
		eP = curves[i+1].EndPoint;
		i = i + 1;
	}

	if (eP == null)
	{
		outp[j] = curves[i];
	}
	else
	{
		outp[j] = Line.ByStartPointEndPoint(sP, eP);
	}
	i = i + 1;
	j = j + 1;
}

if (i == len1)
{
	outp[j] = curves[-1];
}

return = outp;
};
# ----------------------------------------
VARcurveLoop_2 = Output(code_block.out2)  # "VARcurveLoop"
