# Dynamo custom node SP.NullAllIndicesOf.dyf (Dynamo 2.1.0.7500)
# category: Synthesize.Packages.Springs.Core.List
# list all of the indices of a list that match the specified value. Capable of handling null values, part of the SmartCopyMonitor workflow.

VARlist = Input(VARlist: var[])
VARvalue = Input(VARvalue: var)
code_block = CodeBlock(l1=VARlist, val=VARvalue)
# ---------- code_block.designscript (17 lines) ----------
def NullAllInd(l1:var[],val)
{
return = [Imperative]
{
out1 = [];
for(i in GetKeys(l1))
{
if(l1[i] == val)
{
out1 = Flatten([out1, i]);
}
}
return = out1;
}
};

NullAllInd(l1,val);
# ----------------------------------------
VARindices = Output(code_block)
