# Dynamo custom node SP.Number.ToString.dyf (Dynamo 2.1.0.7500)
# category: Synthesize.Packages.Springs.Core.String.Actions
# Converts the input number(s) to string. You can optionally limit the number of digits.

VARnum = Input(VARnum: var[])
VARdigits = Input(VARdigits: int = null)
python_script = Python(IN[0]=VARnum, IN[1]=VARdigits)
# ---------- python_script.python (23 lines) ----------
# Copyright(c) 2017, Dimitar Venkov
# @5devene, dimitar.ven@gmail.com
# www.badmonkeys.net

def tolist(x):
	if hasattr(x,'__iter__'): return x
	else : return [x]

def output(x):
	if len(x) == 1: return x[0]
	else : return x

def n2s(n, digits=IN[1]):
	if digits is not None:
		n = round(n, digits)
	s1 = str(n)
	if s1[-2:] == ".0":
		s1 = s1[:-2]
	return s1

nums = tolist(IN[0])

OUT = output(map(n2s, nums) )
# ----------------------------------------
VARstr = Output(python_script)
