# Dynamo custom node SP.PolyCurve.Chamfer.dyf (Dynamo 2.1.0.7500)
# category: Synthesize.Packages.Springs.Geometry
# Symmetrically chamfers the corners of the polycurve by the designated distance

distance = Input(distance: var)
code_block = CodeBlock { 0; }
eq = distance == code_block
polycurve = Input(polycurve: var)
code_block_2 = CodeBlock(pc=polycurve, d1=distance)
# ---------- code_block_2.designscript (17 lines) ----------
c = pc.Curves();
isClosed = pc.IsClosed;
d2 = c.Length - d1;
spt = c.PointAtSegmentLength(d1);
spar = c.ParameterAtPoint(spt);
ept = c.PointAtSegmentLength(d2);
epar = c.ParameterAtPoint(ept);
spar[0] = isClosed ? spar[0] : 0;
epar[-1] = isClosed ? epar[-1] : 1;
c1 = c.TrimByParameter(spar, epar);
c2 = Line.ByStartPointEndPoint(ept,
  DSCore.List.ShiftIndices(spt, -1) );
drop = isClosed ? 0 : -1;
c2f = DSCore.List.DropItems(c2, drop);
c3 = PolyCurve.ByJoinedCurves(
  List.Clean(Flatten(
  List.Transpose([c1, c2f]) ) ) );
# ----------------------------------------
scopeIf = Custom[CW.ScopeIf+](VARtest=eq, VARtrue=polycurve, VARfalse=code_block_2.c3)  # A (hopefully) more robust implementation of ScopeIf. Tests a single boolean and returns a value accordingly.
polycurve_2 = Output(scopeIf)  # "polycurve"
