# Dynamo custom node SP.PolyCurve.Fillet+.dyf (Dynamo 2.1.0.7500)
# category: Synthesize.Packages.Springs.Geometry
# Fillet a polycurve in its plane. Unlike the built in node, this works in both in the CW and the CCW direction.

radius = Input(radius: var)
code_block = CodeBlock { 0; }
eq = radius == code_block
polycurve = Input(polycurve: var)
code_block_2 = CodeBlock(pc=polycurve, r=radius)
# ---------- code_block_2.designscript (30 lines) ----------
c = pc.Curves();
isClosed = pc.IsClosed;
shift = isClosed ? 1 : 0;
c0 = DSCore.List.ShiftIndices(c, shift);
drop = isClosed ? 0 : 1;
c0f = DSCore.List.DropItems(c0, drop);
a1 = Arc.ByFillet(c, c0f, r);
p1 = a1.StartPoint;
shift1 = isClosed ? -1 : 1;
p2 = DSCore.List.ShiftIndices(a1.EndPoint, shift1);
par1 = c.ParameterAtPoint(p1);
par2 = c.ParameterAtPoint(p2);
par1f = isClosed ? par1 : par2;
par2f = isClosed ? par2 : par1;
par1f[0] = isClosed ? par1f[0] : 0;
c1 = c.TrimByParameter(par1f, par2f);
c2 = [Imperative]{
if (isClosed)
{
return = PolyCurve.ByJoinedCurves(Flatten(
  List.Transpose([c1, a1]) ) );
}
else
{
  parE = c[-1].ParameterAtPoint(p2[0]);
  cE = c[-1].TrimByParameter(parE,1);
  return = PolyCurve.ByJoinedCurves(Flatten(
    [List.Transpose([c1, a1]), cE]) );
}
};
# ----------------------------------------
scopeIf = Custom[CW.ScopeIf+](VARtest=eq, VARtrue=polycurve, VARfalse=code_block_2.out16)  # A (hopefully) more robust implementation of ScopeIf. Tests a single boolean and returns a value accordingly.
polycurve_2 = Output(scopeIf)  # "polycurve"
