# Dynamo custom node Scale Updater.dyf (Dynamo 2.1.0.7500)
# category: Synthesize.Automate.Family
# Scale Updater

hot_get_all_filter = Custom[HOT.Get All Filter]()  # Get all Filter
string_from_object = FromObject(obj=hot_get_all_filter.VARElement)
code_block = CodeBlock { "SelectionFilterElement"; }
eq = string_from_object == code_block
filterByBoolMask = List.FilterByBoolMask(list=hot_get_all_filter.VARElement, mask=eq)
elements = Custom[CW.SelectionSet.Elements](VARselectionSet=filterByBoolMask.in)  # Retrieves all elements stored in a selection set
isEmpty = List.IsEmpty(list=elements, lacing=Longest)
filterByBoolMask_2 = List.FilterByBoolMask(list=filterByBoolMask.in, mask=isEmpty)
python_all_elements_in_active = Custom[Python All Elements In Active View]()  # Python All Elements In Active View
elements_2 = Custom[CW.SelectionSet.Elements](VARselectionSet=filterByBoolMask_2.out)
contains = List.Contains(list=python_all_elements_in_active, item=elements_2@@L1)
anyTrue = Custom[CW.List.AnyTrue](VARseq=contains)  # Returns true if any item in a list of booleans is true.
filterByBoolMask_3 = List.FilterByBoolMask(list=filterByBoolMask_2.out, mask=anyTrue)
filterByBoolMask_4 = List.FilterByBoolMask(list=hot_get_all_filter.VARName, mask=eq)
filterByBoolMask_5 = List.FilterByBoolMask(list=filterByBoolMask_4.in, mask=isEmpty)
filterByBoolMask_6 = List.FilterByBoolMask(list=filterByBoolMask_5.out, mask=anyTrue)
code_block_2 = CodeBlock { "DONOTDELETE-DYNAMOSCALE"; }
contains_2 = String.Contains(str=filterByBoolMask_6.in, searchFor=code_block_2)
filterByBoolMask_7 = List.FilterByBoolMask(list=filterByBoolMask_3.in, mask=contains_2)
elements_3 = Custom[CW.SelectionSet.Elements](VARselectionSet=filterByBoolMask_7.in)
isEmpty_2 = List.IsEmpty(list=elements_3, lacing=Longest)
filterByBoolMask_8 = List.FilterByBoolMask(list=filterByBoolMask_7.in, mask=isEmpty_2)
eraser = Custom[ST.Tool.Eraser](VARList=filterByBoolMask_8.in)  # Try to delete any element from project
filterByBoolMask_9 = List.FilterByBoolMask(list=filterByBoolMask_6.in, mask=contains_2)
filterByBoolMask_10 = List.FilterByBoolMask(list=filterByBoolMask_9.in, mask=isEmpty_2)
code_block_3 = CodeBlock { ","; }
split = String.Split(str=filterByBoolMask_10.out, separator0=code_block_3)
lastItem = List.LastItem(list=split@L2)
code_block_4 = CodeBlock { "-"; }
split_2 = String.Split(str=lastItem, separator0=code_block_4)
toNumber = String.ToNumber(str=split_2)
python_script = Python(IN[0]=toNumber)
# ---------- python_script.python (80 lines) ----------
# Enable Python support and load DesignScript library
# IMPORTANT : ALL DYNAMO DESIGN SCRIPT NODES ARE AS (dg)
import clr
clr.AddReference('ProtoGeometry')
from Autodesk.DesignScript import Geometry as dg

# EXTENSION Enable ToDSType
clr.AddReference('RevitNodes')
import Revit
clr.ImportExtensions(Revit.Elements)

# Enable Revit Elements
from Revit.Elements import *

# EXTENSION Enable Geometry Conversion Methods
clr.ImportExtensions(Revit.GeometryConversion)

# Enable Revit API
clr.AddReference('RevitAPI')
from Autodesk.Revit.DB import *

# Enable DocumentManager and TransactionManager
clr.AddReference('RevitServices')
from RevitServices.Persistence import DocumentManager
from RevitServices.Transactions import TransactionManager

# Enable ICollection List Translate
clr.AddReference("System")
import System.Collections.Generic
from System.Collections.Generic import List

def ElementById(item, doc):
	try: 
		return doc.GetElement(item).ToDSType(True)
	except:
		try:
			return doc.GetElement(ElementId(item)).ToDSType(True)
		except:
			return None

dataEnteringNode = IN
# Use UnwrapElement(IN[0]) When Translating From Dynamo to Revit
lists=UnwrapElement(IN[0])

# Choose The Current Document
doc = DocumentManager.Instance.CurrentDBDocument
uidoc = DocumentManager.Instance.CurrentUIApplication.ActiveUIDocument
uiapp = DocumentManager.Instance.CurrentUIApplication
app = uiapp.Application

# Create Empty List
result = []

elements = [x for x in FilteredElementCollector(doc).OfClass(FamilyInstance).ToElements()]
comments = []
for e in elements:
	try:
		comments.append(e.get_Parameter(BuiltInParameter.ALL_MODEL_INSTANCE_COMMENTS).AsString())
	except:
		comments.append(None)

for l in lists:
	tmp = []
	for n in l:
		tryget = ElementById(n, doc)
		if tryget == None:
			count = 0
			wanted = None
			for c in comments:
				if str(n) == c:
					wanted = elements[count]
					break
				count += 1
			tmp.append(wanted)
		else:
			tmp.append(tryget)
	result.append(tmp)

# Assign your output to the OUT variable.
OUT = result
# ----------------------------------------
isNull = Object.IsNull(obj=python_script)
anyFalse = Custom[CW.List.AnyFalse](VARseq=isNull)  # Returns true if any item in a list of booleans is false.
filterByBoolMask_11 = List.FilterByBoolMask(list=filterByBoolMask_8.out, mask=anyFalse)
elements_4 = Custom[CW.SelectionSet.Elements](VARselectionSet=filterByBoolMask_11.in)
element_geometry_fixer = Custom[Element.Geometry Fixer](VARElement=elements_4@L2)  # Element.Geometry Fixer
flatten = List.Flatten(list=element_geometry_fixer@L3)
VARElement = Output(flatten)
VARUpdateScalingSettings = Input(VARUpdateScalingSettings: var[]..[])
VARUpdateNewX = Input(VARUpdateNewX: var[]..[])
VARUpdateOLDX = Input(VARUpdateOLDX: var[]..[])
div = VARUpdateNewX / VARUpdateOLDX
filterByBoolMask_12 = List.FilterByBoolMask(list=filterByBoolMask_10.out, mask=anyFalse)
split_3 = String.Split(str=filterByBoolMask_12.in, separator0=code_block_3)
code_block_5 = CodeBlock { "X1"; ":"; "X2"; '\'; }
replace = String.Replace(str=split_3, searchFor=code_block_5.out0, replaceWith=code_block_5.out1)
replace_2 = String.Replace(str=replace, searchFor=code_block_5.out2, replaceWith=code_block_5.out3)
python_script_2 = Python(IN[0]=replace_2)
# ---------- python_script_2.python (28 lines) ----------
import clr
clr.AddReference('ProtoGeometry')
from Autodesk.DesignScript.Geometry import *
#The inputs to this node will be stored as a list in the IN variables.
dataEnteringNode = IN

inside = UnwrapElement(IN[0])

result = []

for each in inside:
	tmplist = []
	for e in each:
		try:
			tmplist.append(int(e))
		except:
			try:
				if e == "f":
					tmplist.append(False)
				elif e == "t":
					tmplist.append(True)
				else:
					tmplist.append(e)
			except:
				pass
	result.append(tmplist)
#Assign your output to the OUT variable.
OUT = result
# ----------------------------------------
transpose = List.Transpose(lists=python_script_2)
code_block_6 = CodeBlock { 2; }
dropItems = List.DropItems(list=transpose, amount=code_block_6)
code_block_7 = CodeBlock(a=dropItems) { a[0]; a[1]; a[2]; a[3]; a[4]; a[5]; a[6]; a[7]; }
toNumber_2 = String.ToNumber(str=code_block_7.out5)
scopeIf = Custom[CW.ScopeIf+](VARtest=VARUpdateScalingSettings, VARtrue=div, VARfalse=toNumber_2)  # A (hopefully) more robust implementation of ScopeIf. Tests a single boolean and returns a value accordingly.
VARUpdateNewY = Input(VARUpdateNewY: var[]..[])
VARUpdateOldNewY = Input(VARUpdateOldNewY: var[]..[])
div_2 = VARUpdateNewY / VARUpdateOldNewY
toNumber_3 = String.ToNumber(str=code_block_7.out6)
scopeIf_2 = Custom[CW.ScopeIf+](VARtest=VARUpdateScalingSettings, VARtrue=div_2, VARfalse=toNumber_3)
VARUpdateNewZ = Input(VARUpdateNewZ: var[]..[])
VARUpdateOldZ = Input(VARUpdateOldZ: var[]..[])
div_3 = VARUpdateNewZ / VARUpdateOldZ
toNumber_4 = String.ToNumber(str=code_block_7.out7)
scopeIf_3 = Custom[CW.ScopeIf+](VARtest=VARUpdateScalingSettings, VARtrue=div_3, VARfalse=toNumber_4)
smart_geometry_scale = Custom[Smart Geometry Scale](VARGeometry=flatten@L2, VARXAmount=scopeIf@L1, VARYAmount=scopeIf_2@L1, VARZAmount=scopeIf_3@L1)  # Smart Geometry Scale
VARKeepAdjacentSurfacesJoined = Input(VARKeepAdjacentSurfacesJoined: var[]..[])
join_adjacent_surfaces_legacy = Custom[Join Adjacent Surfaces Legacy](VARSurfaces=smart_geometry_scale@L2, VARJoinOrNot=VARKeepAdjacentSurfacesJoined)  # Join Adjacent Surfaces
code_block_8 = CodeBlock { false; }
categories = Categories("OST_Mass")  # graph input
VARCustomFamilyTemplate = Input(VARCustomFamilyTemplate: var[]..[])
VARRFTFile = Input(VARRFTFile: var[]..[])
categories_2 = Categories("OST_Mass")
smart_rft_path = Custom[Smart RFT Path](VARRFTFile=VARRFTFile, VARCategory=categories_2)  # Smart RFT Path
count = List.Count(list=python_script_2)
cycle = List.Cycle(list=smart_rft_path, amount=count)
scopeIf_4 = Custom[CW.ScopeIf+](VARtest=VARCustomFamilyTemplate, VARtrue=cycle, VARfalse=code_block_7.out3)
code_block_9 = CodeBlock { false; }
k_family_insert = Custom[K-Family Insert](VARGeometryorSAT=join_adjacent_surfaces_legacy, VARAvoidConfilct=code_block_8, VARFamilyName=code_block_7.out1, VARFamilyNumber=code_block_7.out2, VARFamilyCategory=categories, VARFamilyTemplatePath=scopeIf_4, VARSelfOrigin=code_block_9, lacing=Longest)  # K-Family Insert
VARFamily = Output(k_family_insert.VARFamily)
python_script_3 = Python(IN[0]=filterByBoolMask_11.in, IN[1]=VARUpdateScalingSettings, IN[2]=div, IN[3]=div_2, IN[4]=div_3)
# ---------- python_script_3.python (75 lines) ----------
# Enable Python support and load DesignScript library
# IMPORTANT : ALL DYNAMO DESIGN SCRIPT NODES ARE AS (dg)
import clr
clr.AddReference('ProtoGeometry')
from Autodesk.DesignScript import Geometry as dg

# EXTENSION Enable ToDSType
clr.AddReference('RevitNodes')
import Revit
clr.ImportExtensions(Revit.Elements)

# Enable Revit Elements
from Revit.Elements import *

# EXTENSION Enable Geometry Conversion Methods
clr.ImportExtensions(Revit.GeometryConversion)

# Enable Revit API
clr.AddReference('RevitAPI')
from Autodesk.Revit.DB import *

# Enable DocumentManager and TransactionManager
clr.AddReference('RevitServices')
from RevitServices.Persistence import DocumentManager
from RevitServices.Transactions import TransactionManager

# Enable ICollection List Translate
clr.AddReference("System")
import System.Collections.Generic
from System.Collections.Generic import List

def tolist(obj1):
	if hasattr(obj1,'__iter__'): return obj1
	else: return [obj1]

# Choose The Current Document
doc = DocumentManager.Instance.CurrentDBDocument
uidoc = DocumentManager.Instance.CurrentUIApplication.ActiveUIDocument
uiapp = DocumentManager.Instance.CurrentUIApplication
app = uiapp.Application

dataEnteringNode = IN
# Use UnwrapElement(IN[0]) When Translating From Dynamo to Revit

selfilters = UnwrapElement(IN[0])
update = IN[1]
xm = str(IN[2])
ym = str(IN[3])
zm = str(IN[4])

# Create Empty List
result = []

if update == True:
	TransactionManager.Instance.EnsureInTransaction(doc)
	for s in selfilters:
		currentname = s.Name
		splitted = currentname.split(",")
		keep = splitted[-1]
		splitted = splitted[:-4]
		splitted.append(xm)
		splitted.append(ym)
		splitted.append(zm)
		splitted.append(keep)
		joinedagain = ",".join(splitted)
		ids = list()
		inids = s.GetElementIds()
		doc.Delete(s.Id)
		setcreate = List[ElementId](inids)
		selset = SelectionFilterElement.Create(doc,joinedagain)
		selset.AddSet(setcreate)
		result.append(selset.ToDSType(False))
	TransactionManager.Instance.TransactionTaskDone()
	
OUT = result
# ----------------------------------------
VARUpdatedSelectionFilters = Output(python_script_3)
eraser_2 = Custom[ST.Tool.Eraser](VARList=filterByBoolMask_11.out)
