# Dynamo custom node Scatter Elements.dyf (Dynamo 2.13.1.3887)
# category: Synthesize.Automate.Family
# Scatter Elements
# packages: Synthesize toolkit 12.5.1

VARMaximumNumberofElements = Input(VARMaximumNumberofElements: var[]..[])
VARSpacingBetweenElements = Input(VARSpacingBetweenElements: var[]..[])
VARSurfaces = Input(VARSurfaces: var[]..[])
code_block = CodeBlock { false; }
clean = List.Clean(list=VARSurfaces, preserveIndices=code_block)
flatten = List.Flatten(list=clean)
code_block_2 = CodeBlock { "Autodesk.DesignScript.Geometry.Surface"; }
removeIfNot = List.RemoveIfNot(list=flatten, type=code_block_2)
perimeterCurves = Surface.PerimeterCurves(surface=removeIfNot)
code_block_3 = CodeBlock { 0; }
curves_offset_to_revit = Custom[Curves Offset To Revit Compatibility](VARCurves=perimeterCurves, VAROffset=code_block_3)  # package Synthesize toolkit; Curves Offset To Revit Compatibility
string_from_object = FromObject(obj=curves_offset_to_revit.VARCurves)
code_block_4 = CodeBlock { "Line"; }
contains = String.Contains(string=string_from_object, searchFor=code_block_4)
filterByBoolMask = List.FilterByBoolMask(list=curves_offset_to_revit.VARCurves, mask=contains)
python_empty_2_null = Custom[Python Empty 2 Null](VARIN=filterByBoolMask.in)  # package Synthesize toolkit; Python Null 2 Empty
python_empty_2_null_2 = Custom[Python Empty 2 Null](VARIN=filterByBoolMask.out)
code_block_5 = CodeBlock { 5; }
unit_types = UnitTypes("Length")
displayUnitType = Custom[CW.UnitType.DisplayUnitType](VARunitType=unit_types)  # package Synthesize toolkit; Retrieves the display unit type for a given unit type.
toDisplayUnit = Custom[CW.InternalUnit.ToDisplayUnit](VARval=code_block_5, VARdisplayUnitType=displayUnitType.VARdisplayUnitType)  # package Synthesize toolkit; Converts a value from Revit's internal unit to a given display unit
lines_segmentation_by_distance = Custom[Lines Segmentation By Distance](VARCurves=python_empty_2_null_2, VARSegmentationDistance=toDisplayUnit, lacing=Longest)  # package Synthesize toolkit; Lines Segmentation By Distance
mergeByBoolMask = Custom[SP.List.MergeByBoolMask](VARIn=python_empty_2_null@L2, VAROut=lines_segmentation_by_distance@L2, VARmask=contains@L2)  # package Synthesize toolkit; Merge two lists by a boolean mask list. The true count in the mask should be the same as the length of the true list and vice versa for the false list.
as_polycurve_bycurves = Custom[AS.[&] PolyCurve.ByCurves](VARcurves=mergeByBoolMask)  # package Synthesize toolkit; Create polycurves from an unordered list of curves.
flatten_2 = List.Flatten(list=as_polycurve_bycurves.VARpolyCurve)
closeWithLine = PolyCurve.CloseWithLine(polyCurve=flatten_2)
curves = PolyCurve.Curves(polyCurve=closeWithLine)
VAROffset = Input(VAROffset: var[]..[])
curves_offset_to_revit_2 = Custom[Curves Offset To Revit Compatibility](VARCurves=curves, VAROffset=VAROffset)
startPoint = Curve.StartPoint(curve=curves_offset_to_revit_2.VARCurves)
byPoints = Polygon.ByPoints(points=startPoint)
VARFamilyTypeList = Input(VARFamilyTypeList: var[]..[])
flatten_3 = List.Flatten(list=VARFamilyTypeList)
python_script = Python(IN[0]=VARMaximumNumberofElements, IN[1]=VARSpacingBetweenElements, IN[2]=byPoints, IN[3]=flatten_3)  # IronPython2
# ---------- python_script.python (105 lines) ----------
# Enable Python support and load DesignScript library
# IMPORTANT : ALL DYNAMO DESIGN SCRIPT NODES ARE AS (dg)
import clr
clr.AddReference('ProtoGeometry')
from Autodesk.DesignScript import Geometry as dg

# EXTENSION Enable ToDSType
clr.AddReference('RevitNodes')
import Revit
clr.ImportExtensions(Revit.Elements)

# Enable Revit Elements
from Revit.Elements import *

# EXTENSION Enable Geometry Conversion Methods
clr.ImportExtensions(Revit.GeometryConversion)

# Enable Revit API
clr.AddReference('RevitAPI')
from Autodesk.Revit.DB import *

# Enable DocumentManager and TransactionManager
clr.AddReference('RevitServices')
from RevitServices.Persistence import DocumentManager
from RevitServices.Transactions import TransactionManager

# Enable ICollection List Translate
clr.AddReference("System")
import System.Collections.Generic
from System.Collections.Generic import List


import sys
sys.path.append(r'C:\Program Files (x86)\IronPython 2.7\DLLs')
sys.path.append(r'C:\Program Files (x86)\IronPython 2.7\Lib')

import random
from itertools import compress
# Use UnwrapElement(IN[0]) When Translating From Dynamo to Revit
number=UnwrapElement(IN[0]) * 5
space=UnwrapElement(IN[1])
polygons=IN[2]
famlist = UnwrapElement(IN[3])
surfaces=[]

for each in polygons:
	surfaces.append(dg.Surface.ByPatch(each))
# Choose The Current Document
doc = DocumentManager.Instance.CurrentDBDocument
uidoc = DocumentManager.Instance.CurrentUIApplication.ActiveUIDocument
uiapp = DocumentManager.Instance.CurrentUIApplication
app = uiapp.Application

# Create Empty List
result = []

def containment(poly, pt):
	def is_CCW(A,B,C): return (B.X - A.X) * (C.Y - A.Y) > (B.Y - A.Y) * (C.X - A.X)
	
	wn = 0
	for i in xrange(len(poly)-1):
		if poly[i].Y <= pt.Y:
			if poly[i+1].Y > pt.Y and is_CCW(poly[i], poly[i+1],pt): wn += 1
		else:
			if poly[i+1].Y <=pt.Y and not is_CCW(poly[i], poly[i+1],pt): wn -= 1
	if wn != 0 : return True
	else : return False

bool_list = []
pruned = []
count = 0
for e in surfaces:
	ranumsU = []
	ranumsV = []
	points = []
	for i in range(number):
		ranumsU = random.uniform(0, 1)
		ranumsV = random.uniform(0, 1)
		points.append(dg.Surface.PointAtParameter(e,ranumsU,ranumsV))
	result.append(points)

	poly = polygons[count]
	pts = result[count]

	if 'Polygon' in poly.GetType().ToString():
		poly_pts = list(poly.Points)
	else:
		poly_pts = [c.StartPoint for c in poly.Curves()]
	poly_pts.append(poly_pts[0])
	bool_list = ([containment(poly_pts, p) for p in pts])
	filtered = list(compress(pts, bool_list))
	plist = dg.Point.PruneDuplicates(filtered, space)
	newplist = []
	for z in plist:
		newplist.append(z)
	for epoint in pts:
		epoint.Dispose()
	if len(newplist) > (number/5):
		n = len(newplist) - (number/5)
		del newplist[0:n]
	pruned.append(newplist)
	count = count + 1

# Assign your output to the OUT variable.
OUT = pruned
# ----------------------------------------
flatten_4 = List.Flatten(list=python_script)
python_script_2 = Python(IN[0]=flatten_4, IN[1]=flatten_3)  # IronPython2
# ---------- python_script_2.python (33 lines) ----------
# Created By Karam Baki : karam@aecedx.com
# Enable Python support and load DesignScript library
# IMPORTANT : ALL DYNAMO DESIGN SCRIPT NODES ARE AS (dg)
import clr
clr.AddReference('ProtoGeometry')
from Autodesk.DesignScript import Geometry as dg

import sys
sys.path.append(r'C:\Program Files (x86)\IronPython 2.7\DLLs')
sys.path.append(r'C:\Program Files (x86)\IronPython 2.7\Lib')
import random

def tolist(obj1):
	if hasattr(obj1,'__iter__'): return obj1
	else: return [obj1]

def flatten(x):
    result = []
    for el in x:
        if hasattr(el, "__iter__") and not isinstance(el, basestring):
            result.extend(flatten(el))
        else:
            result.append(el)
    return result
    
pts = IN[0]
types = IN[1]

result = []
for p in pts:
	result.append(random.choice(flatten(tolist(types))))
	
OUT = result
# ----------------------------------------
byPoint = FamilyInstance.ByPoint(familyType=python_script_2, point=flatten_4)
VARFamilyInstance = Output(byPoint)
