# Dynamo custom node Searcher.dyf (Dynamo 2.1.0.7500)
# category: Synthesize.Automate.List
# Searcher

VARInsertMode1InsertatBeginning2Insertat = Input(VARInsertMode1InsertatBeginning2InsertatEnd3InsertBeforeWord4InsertAfterWord5ReplaceWord: var[]..[])
VARWordtoInsert = Input(VARWordtoInsert: var[]..[])
VARStringList = Input(VARStringList: var[]..[])
string_from_object = FromObject(obj=VARStringList)
VARSearchMode1StartsWith2EndsWith3Contai = Input(VARSearchMode1StartsWith2EndsWith3Contains: var[]..[])
VARStringtoSearch = Input(VARStringtoSearch: var[]..[])
code_block = CodeBlock { true; }
startsWith = String.StartsWith(str=string_from_object, searchFor=VARStringtoSearch, ignoreCase=code_block)
endsWith = String.EndsWith(str=string_from_object, searchFor=VARStringtoSearch, ignoreCase=code_block)
contains = String.Contains(str=string_from_object, searchFor=VARStringtoSearch, ignoreCase=code_block)
python_script = Python(IN[0]=VARSearchMode1StartsWith2EndsWith3Contai, IN[1]=startsWith, IN[2]=endsWith, IN[3]=contains)
# ---------- python_script.python (17 lines) ----------
import clr
clr.AddReference('ProtoGeometry')
from Autodesk.DesignScript.Geometry import *
#The inputs to this node will be stored as a list in the IN variables.
dataEnteringNode = IN

mode = IN[0]
startslist = IN[1]
endslist = IN[2]
containslist = IN[3]

if mode == 1:
	OUT = startslist
elif mode == 2:
	OUT = endslist
elif mode ==3:
	OUT = containslist
# ----------------------------------------
filterByBoolMask = List.FilterByBoolMask(list=string_from_object, mask=python_script)

# group: Beg
code_block_2 = CodeBlock(a=VARWordtoInsert, b=filterByBoolMask.in) { a+b; }

# group: End
code_block_3 = CodeBlock(a=filterByBoolMask.in, b=VARWordtoInsert) { a+b; }

VARWordtoTargetBeforeorAfterWordorReplac = Input(VARWordtoTargetBeforeorAfterWordorReplaceWordMode: var[]..[])
code_block_4 = CodeBlock(a=VARWordtoInsert, b=VARWordtoTargetBeforeorAfterWordorReplac) { a+b; }

# group: Insert Before
replace = String.Replace(str=filterByBoolMask.in, searchFor=VARWordtoTargetBeforeorAfterWordorReplac, replaceWith=code_block_4)

code_block_5 = CodeBlock(a=VARWordtoTargetBeforeorAfterWordorReplac, b=VARWordtoInsert) { a+b; }

# group: Insert After
replace_2 = String.Replace(str=filterByBoolMask.in, searchFor=VARWordtoTargetBeforeorAfterWordorReplac, replaceWith=code_block_5)

# group: Replace While Inserting
replace_3 = String.Replace(str=filterByBoolMask.in, searchFor=VARWordtoTargetBeforeorAfterWordorReplac, replaceWith=VARWordtoInsert)

python_script_2 = Python(IN[0]=VARInsertMode1InsertatBeginning2Insertat, IN[1]=code_block_2, IN[2]=code_block_3, IN[3]=replace, IN[4]=replace_2, IN[5]=replace_3)
# ---------- python_script_2.python (23 lines) ----------
import clr
clr.AddReference('ProtoGeometry')
from Autodesk.DesignScript.Geometry import *
#The inputs to this node will be stored as a list in the IN variables.
dataEnteringNode = IN

mode = IN[0]
insertstart = IN[1]
insertend = IN[2]
insertbefore = IN[3]
insertafter = IN[4]
replace = IN[5]

if mode == 1:
	OUT = insertstart
elif mode == 2:
	OUT = insertend
elif mode ==3:
	OUT = insertbefore
elif mode == 4:
	OUT = insertafter
elif mode == 5:
	OUT = replace
# ----------------------------------------
mergeByBoolMask = Custom[SP.List.MergeByBoolMask](VARIn=python_script_2, VAROut=filterByBoolMask.out, VARmask=python_script)  # Merge two lists by a boolean mask list. The true count in the mask should be the same as the length of the true list and vice versa for the false list.
VAROut = Output(mergeByBoolMask)
VARChangedItems = Output(python_script)
