# Dynamo custom node Select All Topography From Topography.dyf (Dynamo 2.1.0.7500)
# category: Synthesize.Automate.Topography
# Select Subregions From Topography

VARTopography = Input(VARTopography: var[]..[])
python_script = Python(IN[0]=VARTopography)
# ---------- python_script.python (57 lines) ----------
# Enable Python support and load DesignScript library
# IMPORTANT : ALL DYNAMO DESIGN SCRIPT NODES ARE AS (dg)
import clr
clr.AddReference('ProtoGeometry')
from Autodesk.DesignScript import Geometry as dg

# EXTENSION Enable ToDSType
clr.AddReference('RevitNodes')
import Revit
clr.ImportExtensions(Revit.Elements)

# Enable Revit Elements
from Revit.Elements import *

# EXTENSION Enable Geometry Conversion Methods
clr.ImportExtensions(Revit.GeometryConversion)

# Enable Revit API
clr.AddReference('RevitAPI')
from Autodesk.Revit.DB import *

# Enable DocumentManager and TransactionManager
clr.AddReference('RevitServices')
from RevitServices.Persistence import DocumentManager
from RevitServices.Transactions import TransactionManager

# Enable ICollection List Translate
clr.AddReference("System")
import System.Collections.Generic
from System.Collections.Generic import List

def tolist(obj1):
	if hasattr(obj1,'__iter__'): return obj1
	else: return [obj1]

dataEnteringNode = IN
# Use UnwrapElement(IN[0]) When Translating From Dynamo to Revit
sub = UnwrapElement(tolist(IN[0])[0])

# Choose The Current Document
doc = DocumentManager.Instance.CurrentDBDocument
uidoc = DocumentManager.Instance.CurrentUIApplication.ActiveUIDocument
uiapp = DocumentManager.Instance.CurrentUIApplication
app = uiapp.Application

try:
	if sub.IsSiteSubRegion:
		sub = doc.GetElement(sub.AsSiteSubRegion().HostId)
	subs = sub.GetHostedSubRegionIds()
	result = []
	for s in subs:
		result.append(doc.GetElement(s))
except:
	result = sub

# Assign your output to the OUT variable.
OUT = tolist(result),sub
# ----------------------------------------
code_block = CodeBlock(a=python_script) { a[0]; a[1]; }
VARSubregionsList = Output(code_block.out0)
VARHostTopography = Output(code_block.out1)
