# Dynamo custom node Smart Explode.dyf (Dynamo 2.1.0.7500)
# category: Synthesize.Automate.Geometry
# Smart Explode

VARGeometry = Input(VARGeometry: var[]..[])
VARExplodeOrNot = Input(VARExplodeOrNot: bool = true)
python_script = Python(IN[0]=VARGeometry, IN[1]=VARExplodeOrNot)
# ---------- python_script.python (42 lines) ----------
import clr
clr.AddReference('ProtoGeometry')
from Autodesk.DesignScript import Geometry as dg

def tolist(obj1):
	if hasattr(obj1,'__iter__'): return obj1
	else: return [obj1]

def flatten(x):
    result = []
    try:
    	for el in x:
        	if hasattr(el, "__iter__") and not isinstance(el, basestring):
        	    result.extend(flatten(el))
        	else:
        	    result.append(el)
    except:
    	result = x
    return result

geoms = flatten(tolist(IN[0]))
explodeprnot = IN[1]

if explodeprnot:
	filteredsolids = []
	lefts = []
	for e in geoms:
		if isinstance(e,dg.Solid) or isinstance(e,dg.PolySurface) or isinstance(e,dg.Cuboid):
			try:
				exploded = dg.Geometry.Explode(e)
			except:
				exploded = e
			filteredsolids.append(exploded)
		else:
			lefts.append(e)
	filteredsolids = flatten(filteredsolids)
	result = filteredsolids + lefts
else:
	result = IN[0]

#Assign your output to the OUT variable.
OUT = result
# ----------------------------------------
VARGeometry_2 = Output(python_script)  # "VARGeometry"
