# Dynamo custom node Smart Geometry Scale.dyf (Dynamo 2.1.0.7500)
# category: Synthesize.Automate.Geometry
# Smart Geometry Scale

VARXAmount = Input(VARXAmount: double = 1)
VARYAmount = Input(VARYAmount: double = 1)
VARZAmount = Input(VARZAmount: double = 1)
python_script = Python(IN[0]=VARXAmount, IN[1]=VARYAmount, IN[2]=VARZAmount)
# ---------- python_script.python (11 lines) ----------
import clr
clr.AddReference('ProtoGeometry')
from Autodesk.DesignScript.Geometry import *

if IN[0] == IN[1] and IN[0] == IN[2] and IN[0] != 1:
	normalscale = True
else:
	normalscale = False

#Assign your output to the OUT variable.
OUT = normalscale
# ----------------------------------------
VARGeometry = Input(VARGeometry: var[]..[])
empty = List.Empty()
scopeIf = Custom[CW.ScopeIf+](VARtest=python_script, VARtrue=VARGeometry, VARfalse=empty)  # A (hopefully) more robust implementation of ScopeIf. Tests a single boolean and returns a value accordingly.
scale = Geometry.Scale(geometry=scopeIf, xamount=VARXAmount, yamount=VARYAmount, zamount=VARZAmount)
python_script_2 = Python(IN[0]=VARXAmount, IN[1]=VARYAmount, IN[2]=VARZAmount)
# ---------- python_script_2.python (6 lines) ----------
import clr
clr.AddReference('ProtoGeometry')
from Autodesk.DesignScript.Geometry import *

#Assign your output to the OUT variable.
OUT = IN[0] == 1 and IN[1] == 1 and IN[2] == 1
# ----------------------------------------
empty_2 = List.Empty()
scopeIf_2 = Custom[CW.ScopeIf+](VARtest=python_script, VARtrue=empty, VARfalse=VARGeometry)
scopeIf_3 = Custom[CW.ScopeIf+](VARtest=python_script_2, VARtrue=empty_2, VARfalse=scopeIf_2)
flatten = List.Flatten(list=scopeIf_3)
code_block = CodeBlock { "Surface"; }
byClassName = Custom[SP.Filter.ByClassName](VARobject=flatten, VARclassName=code_block)  # Filters a list of objects by the object's class name. Note that Dynamo elements belong to different classes than their Revit counterparts. Use the Object.Class node to check an object's class.
scale_2 = Geometry.Scale(geometry=byClassName.VARin, xamount=VARXAmount, yamount=VARYAmount, zamount=VARZAmount)
perimeterCurves = Surface.PerimeterCurves(surface=byClassName.VARin)
scale_3 = Geometry.Scale(geometry=perimeterCurves, xamount=VARXAmount, yamount=VARYAmount, zamount=VARZAmount)
as_polycurve_bycurves = Custom[AS.[&] PolyCurve.ByCurves](VARcurves=scale_3)  # Create polycurves from an unordered list of curves.
python_script_3 = Python(IN[0]=scale_2, IN[1]=as_polycurve_bycurves.VARpolyCurve)
# ---------- python_script_3.python (55 lines) ----------
# Enable Python support and load DesignScript library
# IMPORTANT : ALL DYNAMO DESIGN SCRIPT NODES ARE AS (dg)
import clr
clr.AddReference('ProtoGeometry')
from Autodesk.DesignScript import Geometry as dg

# EXTENSION Enable ToDSType
clr.AddReference('RevitNodes')
import Revit
clr.ImportExtensions(Revit.Elements)

# Enable Revit Elements
from Revit.Elements import *

# EXTENSION Enable Geometry Conversion Methods
clr.ImportExtensions(Revit.GeometryConversion)

# Enable Revit API
clr.AddReference('RevitAPI')
from Autodesk.Revit.DB import *

# Enable DocumentManager and TransactionManager
clr.AddReference('RevitServices')
from RevitServices.Persistence import DocumentManager
from RevitServices.Transactions import TransactionManager

# Enable ICollection List Translate
clr.AddReference("System")
import System.Collections.Generic
from System.Collections.Generic import List

dataEnteringNode = IN
# Use UnwrapElement(IN[0]) When Translating From Dynamo to Revit
surfs=UnwrapElement(IN[0])
lists=UnwrapElement(IN[1])

# Choose The Current Document
doc = DocumentManager.Instance.CurrentDBDocument
uidoc = DocumentManager.Instance.CurrentUIApplication.ActiveUIDocument
uiapp = DocumentManager.Instance.CurrentUIApplication
app = uiapp.Application

# Create Empty List
result = []

count = 0
for s in surfs:
	try:
		result.append(dg.Surface.TrimWithEdgeLoops(s,lists[count]))
	except:
		result.append(s)
	count += 1

# Assign your output to the OUT variable.
OUT = result
# ----------------------------------------
scale_4 = Geometry.Scale(geometry=byClassName.VARout, xamount=VARXAmount, yamount=VARYAmount, zamount=VARZAmount)
mergeByBoolMask = Custom[SP.List.MergeByBoolMask](VARIn=python_script_3, VAROut=scale_4, VARmask=byClassName.VARbool)  # Merge two lists by a boolean mask list. The true count in the mask should be the same as the length of the true list and vice versa for the false list.
scopeIf_4 = Custom[CW.ScopeIf+](VARtest=python_script_2, VARtrue=VARGeometry, VARfalse=mergeByBoolMask)
scopeIf_5 = Custom[CW.ScopeIf+](VARtest=python_script, VARtrue=scale, VARfalse=scopeIf_4)
VARGeometry_2 = Output(scopeIf_5)  # "VARGeometry"
