# Dynamo custom node Smart Points By Surfaces.dyf (Dynamo 2.1.0.7500)
# category: Synthesize.Automate.Surface
# Smart Points By Surfaces

VARSurfaces = Input(VARSurfaces: var[]..[])
flatten = List.Flatten(list=VARSurfaces)
perimeterCurves = Surface.PerimeterCurves(surface=flatten)
as_polycurve_bycurves = Custom[AS.[&] PolyCurve.ByCurves](VARcurves=perimeterCurves)  # Create polycurves from an unordered list of curves.
code_block = CodeBlock { false; }
clean = List.Clean(list=as_polycurve_bycurves.VARpolyCurve, preserveIndices=code_block)
flatten_2 = List.Flatten(list=clean)
curves = PolyCurve.Curves(polyCurve=flatten_2)
VAROffsetFromWalls = Input(VAROffsetFromWalls: var[]..[])
curves_offset_to_revit = Custom[Curves Offset To Revit Compatibility](VARCurves=curves, VAROffset=VAROffsetFromWalls)  # Curves Offset To Revit Compatibility
byJoinedCurves = PolyCurve.ByJoinedCurves(curves=curves_offset_to_revit.VARCurves)
byPatch = Surface.ByPatch(closedCurve=byJoinedCurves)
isNull = Object.IsNull(obj=byPatch)
filterByBoolMask = List.FilterByBoolMask(list=curves_offset_to_revit.VARCurves, mask=isNull)
VARCurvesDivideTollerance = Input(VARCurvesDivideTollerance: var[]..[])
python_script = Python(IN[0]=filterByBoolMask.out, IN[1]=VARCurvesDivideTollerance)
# ---------- python_script.python (86 lines) ----------
# Enable Python support and load DesignScript library
# IMPORTANT : ALL DYNAMO DESIGN SCRIPT NODES ARE AS (dg)
import clr
clr.AddReference('ProtoGeometry')
from Autodesk.DesignScript import Geometry as dg

# EXTENSION Enable ToDSType
clr.AddReference('RevitNodes')
import Revit
clr.ImportExtensions(Revit.Elements)

# Enable Revit Elements
from Revit.Elements import *

# EXTENSION Enable Geometry Conversion Methods
clr.ImportExtensions(Revit.GeometryConversion)

# Enable Revit API
clr.AddReference('RevitAPI')
from Autodesk.Revit.DB import *

# Enable DocumentManager and TransactionManager
clr.AddReference('RevitServices')
from RevitServices.Persistence import DocumentManager
from RevitServices.Transactions import TransactionManager

# Enable ICollection List Translate
clr.AddReference("System")
import System.Collections.Generic
from System.Collections.Generic import List
from System import Array

def tolist(obj1):
	if hasattr(obj1,'__iter__'): return obj1
	else: return [obj1]

def smartsplit(curve,division,minimumsplits):
	long = curve.Length
	parts = round(long/division)
	if parts < minimumsplits:
		parts = minimumsplits
	divfactor = 1.0/parts
	alldivs = []
	times = range(int(parts))
	divins = 0
	alldivs.append(divins)
	for e in times:
		divins += divfactor
		alldivs.append(divins)
	cparams = Array[float](alldivs)
	csplitted = dg.Curve.SplitByParameter(curve,cparams)
	return csplitted

def flatten(x):
    result = []
    for el in x:
        if hasattr(el, "__iter__") and not isinstance(el, basestring):
            result.extend(flatten(el))
        else:
            result.append(el)
    return result

dataEnteringNode = IN
# Use UnwrapElement(IN[0]) When Translating From Dynamo to Revit
stuff = UnwrapElement(tolist(IN[0]))
division = IN[1]

# Choose The Current Document
doc = DocumentManager.Instance.CurrentDBDocument
uidoc = DocumentManager.Instance.CurrentUIApplication.ActiveUIDocument
uiapp = DocumentManager.Instance.CurrentUIApplication
app = uiapp.Application

# Create Empty List
result = []

for e in stuff:
	tmplist = []
	for i in e:
		if isinstance(i, dg.Line) == False:
			tmplist.append(smartsplit(i,division,3))
		else:
			tmplist.append(i)
	result.append(flatten(tmplist))
# Assign your output to the OUT variable.
OUT = result
# ----------------------------------------
length = Curve.Length(curve=python_script)
maximumItem = List.MaximumItem(list=length)
eq = length == maximumItem
filterByBoolMask_2 = List.FilterByBoolMask(list=python_script, mask=eq)
firstItem = List.FirstItem(list=filterByBoolMask_2.in@L2)
code_block_2 = CodeBlock { 0.5; }
pointAtParameter = Curve.PointAtParameter(curve=firstItem, param=code_block_2)
filterByBoolMask_3 = List.FilterByBoolMask(list=byPatch, mask=isNull)
code_block_3 = CodeBlock { 0.5; }
normalAtParameter = Surface.NormalAtParameter(surface=filterByBoolMask_3.out, u=code_block_3, v=code_block_3)
byOriginNormalXAxis = Plane.ByOriginNormalXAxis(origin=pointAtParameter, normal=normalAtParameter)
join = List.Join()  # unwired: list0, list1
approximateWithTolerance = Surface.ApproximateWithTolerance(surface=filterByBoolMask_3.out)
byIsoCurveOnSurface = Curve.ByIsoCurveOnSurface(baseSurface=approximateWithTolerance)
length_2 = Curve.Length(curve=byIsoCurveOnSurface)
code_block_4 = CodeBlock { 1; }
byIsoCurveOnSurface_2 = Curve.ByIsoCurveOnSurface(baseSurface=approximateWithTolerance, direction=code_block_4)
length_3 = Curve.Length(curve=byIsoCurveOnSurface_2)
combine = List.Combine(comb=join, list1=length_2, list2=length_3)
maximumItem_2 = List.MaximumItem(list=combine)
code_block_5 = CodeBlock { 2; }
mul = maximumItem_2 * code_block_5
byWidthLength = Rectangle.ByWidthLength(plane=byOriginNormalXAxis, width=mul, length=mul)
byPatch_2 = Surface.ByPatch(closedCurve=byWidthLength)
approximateWithTolerance_2 = Surface.ApproximateWithTolerance(surface=byPatch_2)
byPlane = CoordinateSystem.ByPlane(plane=byOriginNormalXAxis)
startPoint = Curve.StartPoint(curve=firstItem)
endPoint = Curve.EndPoint(curve=firstItem)
byTwoPoints = Vector.ByTwoPoints(start=startPoint, end=endPoint)
byOriginNormalXAxis_2 = Plane.ByOriginNormalXAxis(origin=pointAtParameter, normal=normalAtParameter, xAxis=byTwoPoints)
byPlane_2 = CoordinateSystem.ByPlane(plane=byOriginNormalXAxis_2)
transform = Geometry.Transform(geometry=approximateWithTolerance_2, fromCoordinateSystem=byPlane, contextCoordinateSystem=byPlane_2)
byIsoCurveOnSurface_3 = Curve.ByIsoCurveOnSurface(baseSurface=transform)
length_4 = Curve.Length(curve=byIsoCurveOnSurface_3)
VARUDistance = Input(VARUDistance: var[]..[])
div = length_4 / VARUDistance
round = Math.Round(number=div)
code_block_6 = CodeBlock { 2; }
code_block_7 = CodeBlock { 2; }
lt = _ < code_block_7  # unwired: x
replaceByCondition = Replace(item=round, replaceWith=code_block_6, condition=lt)
code_block_8 = CodeBlock { 1; }
byIsoCurveOnSurface_4 = Curve.ByIsoCurveOnSurface(baseSurface=transform, direction=code_block_8)
length_5 = Curve.Length(curve=byIsoCurveOnSurface_4)
VARVDistance = Input(VARVDistance: var[]..[])
div_2 = length_5 / VARVDistance
round_2 = Math.Round(number=div_2)
replaceByCondition_2 = Replace(item=round_2, replaceWith=code_block_6, condition=lt)
gridFromFace = Custom[CW.Paneling.GridFromFace](VARsurface=transform, VARU=replaceByCondition, VARV=replaceByCondition_2)  # Returns UV coordinates, XYZ coordinates and normals for a face with UV subdivision
startPoint_2 = Curve.StartPoint(curve=python_script)
byPoints = Polygon.ByPoints(points=startPoint_2)
containmentTest = Custom[CW.Polygon.ContainmentTest+](VARpolygon=byPoints, VARpoints=gridFromFace.VARPoints)  # A less accurate method that should perform faster than the built-in node for large data sets.
filterByBoolMask_4 = List.FilterByBoolMask(list=gridFromFace.VARPoints, mask=containmentTest)
code_block_9 = CodeBlock { false; }
clean_2 = List.Clean(list=filterByBoolMask_4.in, preserveIndices=code_block_9)
VARPoints = Output(clean_2)
allFalse = List.AllFalse(list=containmentTest@L2)
filterByBoolMask_5 = List.FilterByBoolMask(list=byOriginNormalXAxis_2, mask=allFalse)
VARPlanes = Output(filterByBoolMask_5.out)
