# Dynamo custom node Smart Translate For K-Rationalize.dyf (Dynamo 2.1.0.7500)
# category: Synthesize.Automate.Surface
# Smart Translate For K-Rationalize

VARGeometry = Input(VARGeometry: var[]..[])
byGeometry = BoundingBox.ByGeometry(geom=VARGeometry)
toCuboid = BoundingBox.ToCuboid(boundingBox=byGeometry)
length = Cuboid.Length(cuboid=toCuboid)
width = Cuboid.Width(cuboid=toCuboid)
max = Math.Max(value1=length, value2=width)
VARExtraDistance = Input(VARExtraDistance: double = 1)
add = max + VARExtraDistance
translate = Geometry.Translate(geometry=VARGeometry, xTranslation=add)
VARGeometry_2 = Output(translate)  # "VARGeometry"
