# Dynamo custom node Smart Voronoi Generator Sandbox.dyf (Dynamo 2.1.0.7500)
# category: Synthesize.Automate.Geometry
# Smart Voronoi Generator

VARSurfaces = Input(VARSurfaces: var[]..[])
VARDistancingMethodFalseIsNumbers = Input(VARDistancingMethodFalseIsNumbers: bool = false)
VARUDensity = Input(VARUDensity: int = 6)
VARVDensity = Input(VARVDensity: int = 6)
VARStraightness = Input(VARStraightness: double = 1)
VARXscale = Input(VARXscale: double = 1)
VARYscale = Input(VARYscale: double = 1)
VARZscale = Input(VARZscale: double = 1)
python_script = Python(IN[0]=VARSurfaces, IN[1]=VARDistancingMethodFalseIsNumbers, IN[2]=VARUDensity, IN[3]=VARVDensity, IN[4]=VARStraightness, IN[5]=VARXscale, IN[6]=VARYscale, IN[7]=VARZscale)
# ---------- python_script.python (362 lines) ----------
# IMPORTANT : ALL DYNAMO DESIGN SCRIPT NODES ARE AS (dg)
import clr
clr.AddReference('ProtoGeometry')
from Autodesk.DesignScript import Geometry as dg
clr.AddReference('Tessellation')
import Tessellation

import System
pf_path = System.Environment.GetFolderPath(System.Environment.SpecialFolder.ProgramFilesX86)
import sys
sys.path.append('%s\IronPython 2.7\Lib' %pf_path)
import random

def tolist(obj1):
	if hasattr(obj1,'__iter__'): return obj1
	else: return [obj1]

def flatten(x):
    result = []
    for el in x:
        if hasattr(el, "__iter__") and not isinstance(el, basestring):
            result.extend(flatten(el))
        else:
            result.append(el)
    return result

def normalize(length,nostartend = False,twominonly = False):
	if length != None:
		if length <= 3 and twominonly == False:
			length = 4
		elif length <= 3 and twominonly == True:
			if length < 2:
				length = 2
		if nostartend:
			length += 2
		a = range(0,int(length))
		points = []
		amin, amax = min(a), max(a)
		item = []
		for val in a:
			item.append(float(val-amin) / float(amax-amin))
	else:
		item = [None]
	if nostartend == True:
		item.pop(0)
		item.pop(-1)
	return item

def dangeruv(uv):
	if uv.U <= 0 or uv.U >= 1 or uv.V <= 0 or uv.V >= 1:
		return True
	else:
		return False
	return False

def tranlist(list,x,y,z):
	tranned = []
	for l in list:
		tranned.append(dg.Geometry.Translate(l,x,y,z))
	return tranned

def borderOP(uvs,trans_up_down,param,avgU,avgV,strength):
	count = 0
	for trans in trans_up_down:
		for tran in trans:
			c = dg.Circle.ByCenterPointRadius(tran,min([avgU/2,avgV/2])/strength)
			uv = dg.Surface.UVParameterAtPoint(proxysurf,dg.Curve.PointAtParameter(c,param[count]))
			uvs.append(uv)
		count += 1
	return uvs

def borderOP_static(uvs,trans_up_down,param,avgU,avgV,strength):
	for trans in trans_up_down:
		for tran in trans:
			#c = dg.Circle.ByCenterPointRadius(tran,min([avgU/2,avgV/2])/strength)
			c = dg.Circle.ByCenterPointRadius(tran,min([avgU/2,avgV/2]))
			uv = dg.Surface.UVParameterAtPoint(proxysurf,dg.Curve.PointAtParameter(c,param))
			uvs.append(uv)
	return uvs

def average(num):
    sum_num = 0
    for t in num:
        sum_num = sum_num + t           

    avg = sum_num / len(num)
    return avg

def get_trans(up_down,disU,switch):
	if switch:
		up_down.insert(0,tranlist(up_down[0],0,-disU,0))
		up_down.insert(3,tranlist(up_down[-1],0,disU,0))
	else:
		up_down.insert(0,tranlist(up_down[0],-disU,0,0))
		up_down.insert(3,tranlist(up_down[-1],disU,0,0))
	trans_up_down = [list(x) for x in zip(*up_down)]
	return trans_up_down

def joinsurfs(surfs):
	def surf_doesinter(a,b,tollerance = 0.00001):
		if round(dg.Geometry.DistanceTo(a,b),2) < tollerance:
			return True
		else:
			return False
	surfacesflatten = flatten(surfs)
	surfacesflatten = [x for x in surfacesflatten if x]
	if surfacesflatten != None and surfacesflatten != []:
		crvs = flatten(tolist(surfs))
		crvGroup = [-1 for x in range(len(crvs))]
		crvGroup[0] = 0
		maxGroupNum = 1
		for i in range(len(crvs)):
			if (crvGroup[i] == -1):
				crvGroup[i] = i
			for j in range(len(crvs)):
				try:
					if i != j and surf_doesinter(crvs[i], crvs[j]):
						if (crvGroup[j] == -1):
							crvGroup[j] = crvGroup[i]
						elif (crvGroup[i] != crvGroup[j]):
							oldNum = crvGroup[j]
							for k in range(len(crvs)):
								if (crvGroup[k] == oldNum):
									crvGroup[k] = crvGroup[i]
				except:
					pass
		groups = []
		excluded = []
		for n in crvGroup:
			innercount = 0
			tmp = []
			for n2 in crvGroup:
				if n == n2 and n2 not in excluded:
					tmp.append(crvs[innercount])
				innercount += 1
			if len(tmp) == 0:
				continue
			try:
				tmp = dg.Surface.ByUnion(tmp)
				groups.append(tmp)
			except:
				try:
					tmp = dg.PolySurface.ByJoinedSurfaces(tmp)
					groups.append(tmp)
				except:
					for t in tmp:
						groups.append(t)
			excluded.append(n)
		joinedsurfs = groups
		return joinedsurfs
	else:
		return surfs

def flipuv(uv,attempts):
	if attempts == 1:
		U = 1-uv.U
		V = 1-uv.V
		return dg.UV.ByCoordinates(U,V)
	if attempts == 2:
		U = uv.U
		V = uv.V
		return dg.UV.ByCoordinates(V,U)
	if attempts == 3:
		U = 1-uv.U
		V = 1-uv.V
		return dg.UV.ByCoordinates(V,U)

inputfaces = joinsurfs(flatten(tolist(IN[0])))
bydistance = IN[1]
disUinput = IN[2]
disVinput = IN[3]
strength = IN[4]
xscale = IN[5]
yscale = IN[6]
zscale = IN[7]

if strength < 1:
	strength = 1

if len(inputfaces) > 1:
	static_factor = 0.5
else:
	static_factor = random.uniform(0, 1)

bigresult = []
bigresultfaces = []
explodedinputfaces = []
for input in inputfaces:
	exploded = dg.Geometry.Explode(input)
	disesU = []
	disesV = []
	ptslists = []
	proxysurfs = []
	for face in exploded:
		l = dg.Curve.ByIsoCurveOnSurface(face,0,0.5).Length
		w = dg.Curve.ByIsoCurveOnSurface(face,1,0.5).Length
		proxysurf = dg.Surface.ByPatch(dg.Rectangle.ByWidthLength(l,w))
		if bydistance:
			U = round(l/disUinput)
			V = round(w/disVinput)
		else:
			U = disUinput
			V = disVinput
		normU = normalize(U)
		normV=  normalize(V)
		pts = []
		for nU in normU:
			tmp  = []
			for nV in normV:
				tmp.append(dg.Surface.PointAtParameter(proxysurf,nU,nV))
			pts.append(tmp)
		disU = dg.Geometry.DistanceTo(pts[0][0],pts[1][0])
		disV = dg.Geometry.DistanceTo(pts[0][0],pts[0][1])
		disesU.append(disU)
		disesV.append(disV)
		ptslists.append(pts)
		proxysurfs.append(proxysurf)
	
	param = False
	param_static = random.uniform(0, 1)
	result = []
	resultfaces = []
	count = 0
	for face in exploded:
		disU = disesU[count]
		disV = disesV[count]
		pts = ptslists[count]
		#otherlist = others[count]
		otherlist = [] #########
		proxysurf = proxysurfs[count]
		
		transpts = [list(x) for x in zip(*pts)]
		
		up_down = [pts[0],pts[-1]]
		left_right = [transpts[0][1:-1],transpts[-1][1:-1]]
		
		corner = []
		for udlist in up_down:
			corner.append(dg.Geometry.Translate(udlist[0],0,-disV,0))
			corner.append(dg.Geometry.Translate(udlist[-1],0,disV,0))
		corner = [corner]
		trans_corner = get_trans(corner,disU,False)
	
		trans_up_down = get_trans(up_down,disU,False)
		trans_left_right = get_trans(left_right,disV,True)
	
		ptstoremove = flatten(up_down + left_right)
		pts = list(set(flatten(pts)) - set(ptstoremove))
	
		uvs = []
		for p in pts:
			c = dg.Circle.ByCenterPointRadius(p,min([disU/2,disV/2])/strength)
			uv = dg.Surface.UVParameterAtPoint(proxysurf,dg.Curve.PointAtParameter(c,random.uniform(0, 1)))
			while dangeruv(uv):
				uv = dg.Surface.UVParameterAtPoint(proxysurf,dg.Curve.PointAtParameter(c,random.uniform(0, 1)))
			uvs.append(uv)
		
		#param = False
		uvs = borderOP_static(uvs,trans_up_down,static_factor,disU,disV,strength)
		uvs = borderOP_static(uvs,trans_left_right,static_factor,disU,disV,strength)
		
		#param = random.uniform(0, 1)
		uvs = borderOP_static(uvs,trans_corner,static_factor,disU,disV,strength)
	
		vorocurves = Tessellation.Voronoi.ByParametersOnSurface(uvs,proxysurf)
		cleancurves = []
		for vc in vorocurves:
			try:
				cleancurves.append(dg.Geometry.Translate(vc,0,0,-0.5))
			except:
				pass
				
		thicken = []
		for clean in cleancurves:
			thicken.append(dg.Curve.Extrude(clean,dg.Vector.ByCoordinates(0,0,1),1))
			
		joinedsurfs = dg.PolySurface.ByJoinedSurfaces(thicken)
		splits = dg.Geometry.Split(proxysurf,joinedsurfs)
		joinedsurfs.Dispose()
		for t in thicken:
			t.Dispose()
			
		allfaces = [face] + otherlist
		works = False
		switch = False
		attempts = 0
		while not works and attempts < 4:
			finalcurves = []
			for s in splits:
				perms = s.PerimeterCurves()
				pts = []
				tmp = []
				stTmp = []
				enTmp = []
				for p in perms:
					stUV = dg.Surface.UVParameterAtPoint(proxysurf,p.StartPoint)
					enUV = dg.Surface.UVParameterAtPoint(proxysurf,p.EndPoint)
					tmpf = []
					for f in allfaces:
						try:
							fperms = f.PerimeterCurves()
							stUVnew = False
							enUVnew = False
							if switch: 
								stUVnew = flipuv(stUV,attempts)
								enUVnew = flipuv(enUV,attempts)
							if stUVnew == False:
								newcurve = dg.Curve.ByParameterLineOnSurface(f,stUV,enUV)
							else:
								newcurve = dg.Curve.ByParameterLineOnSurface(f,stUVnew,enUVnew)
							if xscale == 1 and yscale == 1 and zscale == 1:
								pass
							else:
								newcurve = dg.Geometry.Scale(newcurve,xscale,yscale,zscale)
								newcurve = dg.Curve.PullOntoSurface(newcurve,f)
							testpoint = dg.Curve.PointAtParameter(newcurve,0.5)
							isgood = True
							for fperm in fperms:
								if dg.Geometry.DistanceTo(fperm, testpoint) < 0.01:
									isgood = False
									break
							if isgood:
								intersects = dg.Geometry.Intersect(newcurve,f)
								cleanintersects = []
								for i in intersects:
									if isinstance(i, dg.Point) == False and isinstance(i, dg.Arc) == False:
										cleanintersects.append(i)
									if isinstance(i, dg.Arc):
										pulled = dg.Curve.PullOntoSurface(dg.Line.ByStartPointEndPoint(i.StartPoint,i.EndPoint),f)
										cleanintersects.append(pulled)
								tmpf.append(cleanintersects)
							else:
								tmpf.append(None)
						except:
							tmpf.append(None)
					tmp.append(tmpf)
				finalcurves.append([list(x) for x in zip(*tmp)])
			to_out = [list(x) for x in zip(*finalcurves)]
			if len(result) == 0:
				works = True
			else:
				testlist = flatten(result)
				testlist2 = flatten(to_out)
				testlist = [i for i in testlist if i]
				testlist2 = [i for i in testlist2 if i]
				for test in testlist:
					for test2 in testlist2:
						if dg.Geometry.DistanceTo(test,test2) < 0.1:
							switch = False
							works = True
							break
					if works == True:
						break
					switch = True
			attempts += 1
		result.append(to_out)
		if len(to_out) != 0:
			resultfaces.append(allfaces)
		count += 1
	bigresult.append(result)
	bigresultfaces.append(resultfaces)
OUT = bigresult,bigresultfaces
# ----------------------------------------
code_block = CodeBlock(a=python_script) { a[0]; a[1]; }
code_block_2 = CodeBlock { false; }
clean = List.Clean(list=code_block.out0, preserveIndices=code_block_2)
flatten = List.Flatten(list=clean@@L3)
as_polycurve_bycurves_with = Custom[AS.[&] PolyCurve.ByCurves With Failures Sandbox](VARcurves=flatten)  # Create polycurves from an unordered list of curves.
flatten_2 = List.Flatten(list=as_polycurve_bycurves_with.VARpolyCurve@L4)
VARJoinedCurves = Output(flatten_2)
flatten_3 = List.Flatten(list=code_block.out1)
VARSurfaces_2 = Output(flatten_3)  # "VARSurfaces"
