# Dynamo custom node Solid By Divided Path Slicer.dyf (Dynamo 2.13.1.3887)
# category: Synthesize.Automate.Solid
# Solid By Face Reference Slicer
# packages: Synthesize toolkit 12.5.1

VARDividedPath = Input(VARDividedPath: var[]..[])
VARDividedPathPrecision = Input(VARDividedPathPrecision: var[]..[])
planes_and_curve_of_divided_path = Custom[Planes and Curve of Divided Path](VARDividedPaths=VARDividedPath, VARPrecisionInFeet=VARDividedPathPrecision)  # package Synthesize toolkit; Planes and Curve of Divided Path
flatten = List.Flatten(list=planes_and_curve_of_divided_path.VARPlanes)
VARGeometry = Input(VARGeometry: var[]..[])
turnIntoList = Custom[CW.TurnIntoList](VARunknownItem=VARGeometry)  # package Synthesize toolkit; Turns an element (or a nested list) into a flat list
flatten_2 = List.Flatten(list=turnIntoList)
intersect = Geometry.Intersect(geometry=flatten_2@L1, other=flatten)
VARExclusionThreshold = Input(VARExclusionThreshold: var[]..[])
python_script = Python(IN[0]=flatten, IN[1]=intersect, IN[2]=VARExclusionThreshold)  # IronPython2
# ---------- python_script.python (77 lines) ----------
# Enable Python support and load DesignScript library
# IMPORTANT : ALL DYNAMO DESIGN SCRIPT NODES ARE AS (dg)
import clr
clr.AddReference('ProtoGeometry')
from Autodesk.DesignScript import Geometry as dg

# EXTENSION Enable ToDSType
clr.AddReference('RevitNodes')
import Revit
clr.ImportExtensions(Revit.Elements)

# Enable Revit Elements
from Revit.Elements import *

# EXTENSION Enable Geometry Conversion Methods
clr.ImportExtensions(Revit.GeometryConversion)

# Enable Revit API
clr.AddReference('RevitAPI')
from Autodesk.Revit.DB import *

# Enable DocumentManager and TransactionManager
clr.AddReference('RevitServices')
from RevitServices.Persistence import DocumentManager
from RevitServices.Transactions import TransactionManager

# Enable ICollection List Translate
clr.AddReference("System")
import System.Collections.Generic
from System.Collections.Generic import List

dataEnteringNode = IN
# Use UnwrapElement(IN[0]) When Translating From Dynamo to Revit
pts=UnwrapElement(IN[0])
surfsbiglist=UnwrapElement(IN[1])
threshold = IN[2]

# Choose The Current Document
doc = DocumentManager.Instance.CurrentDBDocument
uidoc = DocumentManager.Instance.CurrentUIApplication.ActiveUIDocument
uiapp = DocumentManager.Instance.CurrentUIApplication
app = uiapp.Application

# Create Empty List
result = []

for surfslist in surfsbiglist:
	counter = 0
	tmpout = []
	acceptedout = []
	for p in pts:
		p = p.Origin
		tmp = []
		tmpsurf = []
		accepted = []
		wantedlist = surfslist[counter]
		try:
			for w in wantedlist:
				tmp.append(dg.Geometry.DistanceTo(p,w))
				tmpsurf.append(w)
			mindis = min(tmp)
			incounter = 0
			for t in tmp:
				if t == mindis:
					accepted.append(wantedlist[incounter])
				elif t <= threshold:
					accepted.append(wantedlist[incounter])
				incounter += 1
			counter += 1
			acceptedout.append(accepted)
		except:
			acceptedout.append(wantedlist)
			counter += 1
	result.append(acceptedout)

# Assign your output to the OUT variable.
OUT = result
# ----------------------------------------
flatten_3 = List.Flatten(list=python_script@L3)
code_block = CodeBlock { "Autodesk.DesignScript.Geometry.Surface"; }
removeIfNot = List.RemoveIfNot(list=flatten_3@L2, type=code_block)
surface_laundry = Custom[Surface Laundry](VARSurfaceOrPolyCurvesList=removeIfNot@L2)  # package Synthesize toolkit; Surface Laundry
VARthickness = Input(VARthickness: var[]..[])
VARthickenbothsides = Input(VARthickenbothsides: var[]..[])
thicken = Surface.Thicken(surface=surface_laundry, thickness=VARthickness, both_sides=VARthickenbothsides)
VARUnionPieces = Input(VARUnionPieces: var[]..[])
try_union = Custom[Try Union](VARGeometryList=thicken@L2, VARUnionOrNot=VARUnionPieces)  # package Synthesize toolkit; Try Union
VARSolids = Output(try_union)
