# Dynamo custom node Solid.By Loft Fixer.dyf (Dynamo 2.1.0.7500)
# category: Synthesize.Fixers
# Solid.By Loft Fixer

VARcrossSections = Input(VARcrossSections: var[]..[])
byLoft = Solid.ByLoft(crossSections=VARcrossSections)
VARSolid = Output(byLoft)
