# Dynamo custom node Solid.ByUnion Fixer.dyf (Dynamo 2.1.0.7500)
# category: Synthesize.Fixers
# Solid.ByUnion Fixer

VARsolids = Input(VARsolids: var[]..[])
python_script = Python(IN[0]=VARsolids)
# ---------- python_script.python (18 lines) ----------
import clr
clr.AddReference('ProtoGeometry')
from Autodesk.DesignScript.Geometry import *

solids = IN[0]
OUT = [solids[0]]
solids = solids[1:]

for s in solids:
	i = 0
	unionDone = False
	while i < len(OUT):
		try:
			OUT[i] = OUT[i].Union(s)
			unionDone = True
			break
		except:	i += 1
	if not unionDone: OUT.append(s)
# ----------------------------------------
VARSolid = Output(python_script)
