# Dynamo custom node Sort Adaptive By Reference Points.dyf (Dynamo 2.1.0.7500)
# category: Synthesize.Automate.Adaptive
# Sort Adaptive By Points

VARAdaptiveComponents = Input(VARAdaptiveComponents: var[]..[])
filter_adaptive_component = Custom[Filter Adaptive Component FamilyInstances](VARFamilyInstances=VARAdaptiveComponents)  # Filter Adaptive Component FamilyInstances
VARReferencePoints = Input(VARReferencePoints: var[]..[])
python_script = Python(IN[0]=filter_adaptive_component, IN[1]=VARReferencePoints)
# ---------- python_script.python (124 lines) ----------
# Enable Python support and load DesignScript library
# IMPORTANT : ALL DYNAMO DESIGN SCRIPT NODES ARE AS (dg)
import clr
clr.AddReference('ProtoGeometry')
from Autodesk.DesignScript import Geometry as dg

# EXTENSION Enable ToDSType
clr.AddReference('RevitNodes')
import Revit

# EXTENSION Enable Geometry Conversion Methods
clr.ImportExtensions(Revit.GeometryConversion)

# Enable Revit API
clr.AddReference('RevitAPI')
from Autodesk.Revit.DB import *

# Enable DocumentManager and TransactionManager
clr.AddReference('RevitServices')
from RevitServices.Persistence import DocumentManager
from RevitServices.Transactions import TransactionManager

clr.AddReference("RevitAPIUI")
from Autodesk.Revit.UI import TaskDialog

def tolist(obj1):
	if hasattr(obj1,'__iter__'): return obj1
	else: return [obj1]

def flatten(x):
    result = []
    for el in x:
        if hasattr(el, "__iter__") and not isinstance(el, basestring):
            result.extend(flatten(el))
        else:
            result.append(el)
    return result

element = UnwrapElement(flatten(tolist(IN[0])))
sourceRefs = UnwrapElement(flatten(tolist(IN[1])))

filtered = []
for source in sourceRefs:
	if hasattr(source, 'GetCoordinatePlaneReferenceXY'):
		filtered.append(source)

isgood = True
numbers = []
for filt in filtered:
	try:
		numbers.append(int(filter(str.isdigit, filt.LookupParameter("Name").AsString())))
	except:
		isgood = False
		TaskDialog.Show("AECedx - Karam", "One or more Reference Points don't have number in 'Name' parameter to indicate it's order")
		break
		 
if isgood:
	sourceRefs = [x for _, x in sorted(zip(numbers, filtered))]
	
	# Choose The Current Document
	doc = DocumentManager.Instance.CurrentDBDocument
	uidoc = DocumentManager.Instance.CurrentUIApplication.ActiveUIDocument
	uiapp = DocumentManager.Instance.CurrentUIApplication
	app = uiapp.Application
	
	# Create Empty List
	result = []
	
	def getNearestId(sp,pts,ids):
		dises = []
		for pt in pts:
			dises.append(dg.Geometry.DistanceTo(pt,sp))
		mindis = min(dises)
		count = 0
		for dis in dises:
			if dis == mindis:
				wantedid = ids[count]
				break
			count += 1
		return wantedid
	
	
	TransactionManager.Instance.EnsureInTransaction(doc)
	for each in element:
		try:
			ids = AdaptiveComponentInstanceUtils.GetInstancePlacementPointElementRefIds(each)
			tmp = []
			pts = []
			for e in ids:
				refpt = doc.GetElement(e)
				elemref = refpt.GetPointElementReference()
				if elemref == None:
					coor = refpt.GetCoordinateSystem().ToCoordinateSystem()
					pts.append(coor.Origin)
				else:
					coor = refpt.GetCoordinateSystem().ToCoordinateSystem()
					pts.append(coor.Origin)
			sortedIds = []
			sortedTmp = []
			for source in sourceRefs:
				sp = source.GetCoordinateSystem().ToCoordinateSystem().Origin
				nearestId = getNearestId(sp,pts,ids)
				refpt = doc.GetElement(nearestId)
				elemref = refpt.GetPointElementReference()
				if elemref == None:
					coor = refpt.GetCoordinateSystem().ToCoordinateSystem()
					skp = SketchPlane.Create(doc, coor.XYPlane.ToPlane()).GetPlaneReference()
					xcoor = coor.XAxis.ToXyz()
					orcoor = coor.Origin.ToXyz()
					dynpoints = PointOnPlane.NewPointOnPlane(doc,skp,orcoor,xcoor)
					sortedTmp.append(dynpoints)
				else:
					sortedTmp.append(elemref)
			count = 0
			for id in ids:
				refpt = doc.GetElement(id)
				refpt.SetPointElementReference(sortedTmp[count])
				count += 1
			result.append(each)
		except:
			result.append(None)
	TransactionManager.Instance.TransactionTaskDone()
	
	OUT = result
# ----------------------------------------
VARAdaptiveComponents_2 = Output(python_script)  # "VARAdaptiveComponents"
