# Dynamo custom node Square Crop Region Curves By Surface.dyf (Dynamo 2.1.0.7500)
# category: Synthesize.Automate.Views
# Square Crop Region Curves By Surface

VARSurfaces = Input(VARSurfaces: var[]..[])
flatten = List.Flatten(list=VARSurfaces)
code_block = CodeBlock { 0.5; }
pointAtParameter = Surface.PointAtParameter(surface=flatten, u=code_block, v=code_block)
normalAtPoint = Surface.NormalAtPoint(surface=flatten, point=pointAtParameter)
byOriginNormal = Plane.ByOriginNormal(origin=pointAtParameter, normal=normalAtPoint)
byPlane = CoordinateSystem.ByPlane(plane=byOriginNormal)
byOrigin = CoordinateSystem.ByOrigin()
transform = Geometry.Transform(geometry=flatten, fromCoordinateSystem=byPlane, contextCoordinateSystem=byOrigin)
code_block_2 = CodeBlock { 1; }
unit_types = UnitTypes("Length")
displayUnitType = Custom[CW.UnitType.DisplayUnitType](VARunitType=unit_types)  # Retrieves the display unit type for a given unit type.
toDisplayUnit = Custom[CW.InternalUnit.ToDisplayUnit](VARval=code_block_2, VARdisplayUnitType=displayUnitType.VARdisplayUnitType)  # Converts a value from Revit's internal unit to a given display unit
thicken = Surface.Thicken(surface=transform, thickness=toDisplayUnit)
byGeometry = BoundingBox.ByGeometry(geom=thicken@L1)
toCuboid = BoundingBox.ToCuboid(boundingBox=byGeometry)
explode = Geometry.Explode(geometry=toCuboid)
filterByOrientation = Custom[CW.Surface.FilterByOrientation](VARsurfaces=explode)  # Sorts surfaces in three lists based on their orientation (vertical, horizontal up & horizontal down) and also returns three corresponding lists of booleans.
transform_2 = Geometry.Transform(geometry=filterByOrientation.VARhorizontalDown, fromCoordinateSystem=byOrigin, contextCoordinateSystem=byPlane)
perimeterCurves = Surface.PerimeterCurves(surface=transform_2)
as_polycurve_bycurves = Custom[AS.[&] PolyCurve.ByCurves](VARcurves=perimeterCurves)  # Create polycurves from an unordered list of curves.
VAROffset = Input(VAROffset: var[]..[])
offset = Curve.Offset(curve=as_polycurve_bycurves.VARpolyCurve, distance=VAROffset)
flatten_2 = List.Flatten(list=offset)
explode_2 = Geometry.Explode(geometry=flatten_2)
VARCurves = Output(explode_2)
