# Dynamo custom node Stabilize Custom Lines For K-Paneling Function.dyf (Dynamo 2.1.0.7500)
# category: Synthesize.Automate.List
# Stabilize Custom Lines For K-Paneling Function

VARList1 = Input(VARList1: var[]..[])
VARList2 = Input(VARList2: var[]..[])
VARList3 = Input(VARList3: var[]..[])
VARDataExportBool = Input(VARDataExportBool: var[]..[])
python_script = Python(IN[0]=VARList1, IN[1]=VARList2, IN[2]=VARList3, IN[3]=VARDataExportBool)
# ---------- python_script.python (61 lines) ----------
# Load the Python Standard and DesignScript Libraries
import sys
import clr
clr.AddReference('ProtoGeometry')
from Autodesk.DesignScript.Geometry import *

# The inputs to this node will be stored as a list in the IN variables.
dataEnteringNode = IN

def flatten(x):
    result = []
    for el in x:
        if hasattr(el, "__iter__") and not isinstance(el, basestring):
            result.extend(flatten(el))
        else:
            result.append(el)
    return result
 
list1 = UnwrapElement(IN[0])
list2 = UnwrapElement(IN[1])
list3 = UnwrapElement(IN[2])
dataexport = IN[3]

result = []
count = 0
for l in list1:
	l2 = list2[count]
	if list3 != None and len(list3) != 0:
		l3 = list3[count]
		lall = list(l) + list(l2) + list(l3)
	else:
		lall = list(l) + list(l2)
	count += 1
	fix = []
	for el in lall:
		if el != None:
			fix.append(el)
	if len(fix) == 0:
		fix = [None]
	result.append(fix)

countlists = [[],[],[]]
if dataexport:
	countlists = []
	choppedresult = []
	for list in result:
		tmp = []
		tmpcount = []
		for l in list:
			try:
				exploded = Geometry.Explode(l)
				tmp.append(exploded)
				tmpcount.append(len(exploded))
			except:
				tmp.append(None)
				tmpcount.append(0)
		choppedresult.append(flatten(tmp))
		countlists.append(tmpcount)
	result = choppedresult

OUT = result,countlists
# ----------------------------------------
code_block = CodeBlock(a=python_script) { a[0]; a[1]; }
VARCurveLists = Output(code_block.out0)
VARCountLists = Output(code_block.out1)
