# Dynamo custom node Subregions Batch Create.dyf (Dynamo 2.1.0.7500)
# category: Synthesize.Automate.Topography
# Subregions Batch Create

VARRevitCurves = Input(VARRevitCurves: var[]..[])
VARTopography = Input(VARTopography: var[]..[])
VARNumberofSubregionsinEachGroup = Input(VARNumberofSubregionsinEachGroup: int = 10)
python_script = Python(IN[0]=VARRevitCurves, IN[1]=VARTopography, IN[2]=VARNumberofSubregionsinEachGroup)
# ---------- python_script.python (130 lines) ----------
# Enable Python support and load DesignScript library
# IMPORTANT : ALL DYNAMO DESIGN SCRIPT NODES ARE AS (dg)
import clr
clr.AddReference('ProtoGeometry')
from Autodesk.DesignScript import Geometry as dg

# EXTENSION Enable ToDSType
clr.AddReference('RevitNodes')
import Revit
clr.ImportExtensions(Revit.Elements)

# Enable Revit Elements
from Revit.Elements import *

# EXTENSION Enable Geometry Conversion Methods
clr.ImportExtensions(Revit.GeometryConversion)

# Enable Revit API
clr.AddReference('RevitAPI')
from Autodesk.Revit.DB import *
from Autodesk.Revit.DB.Architecture import *
# Enable DocumentManager and TransactionManager
clr.AddReference('RevitServices')
from RevitServices.Persistence import DocumentManager
from RevitServices.Transactions import TransactionManager

# Enable ICollection List Translate
clr.AddReference("System")
import System.Collections.Generic
from System.Collections.Generic import List
import math
from itertools import compress
# Use UnwrapElement(IN[0]) When Translating From Dynamo to Revit
#cadfile=UnwrapElement(IN[0])

# Choose The Current Document
doc = DocumentManager.Instance.CurrentDBDocument
uidoc = DocumentManager.Instance.CurrentUIApplication.ActiveUIDocument
uiapp = DocumentManager.Instance.CurrentUIApplication
app = uiapp.Application


class WarnSwallow(IFailuresPreprocessor):
	def PreprocessFailures(self, failuresAccessor):
		fmas = failuresAccessor.GetFailureMessages()
		if len(fmas) == 0:
			return FailureProcessingResult.Continue
		else:
			for fma in fmas:
				try:
					failuresAccessor.ResolveFailure(fma)
					failuresAccessor.DeleteWarning(fma)
				except:
					try:
						failuresAccessor.DeleteWarning(fma)
					except:
						pass
		return FailureProcessingResult.ProceedWithCommit

# Get input variables
insubregions = UnwrapElement(IN[0])
host = UnwrapElement(IN[1])
groupnum = IN[2]

if host != []:
	def flatten(x):
	    result = []
	    for el in x:
	        if hasattr(el, "__iter__") and not isinstance(el, basestring):
	            result.extend(flatten(el))
	        else:
	            result.append(el)
	    return result
	  
	newlist = []
	for each in insubregions:
		newlist.append(each)
	
	insubregions = newlist
	
	# Init variables
	curveLoops = []
	createdSubRegions = []
	error = []
	results = []
	
	total = len(insubregions)
	TransactionManager.Instance.ForceCloseTransaction()
	tGroup = TransactionGroup(doc, 'Streets From Infraworks')
	tGroup.Start()
	while total > 0:
		TransactionManager.Instance.ForceCloseTransaction()
		trans = Transaction(doc, 'Subregion')
		trans.Start()
		warnhandle = WarnSwallow()
		foptions = trans.GetFailureHandlingOptions()
		foptions.SetFailuresPreprocessor(warnhandle)
		foptions.SetClearAfterRollback(True)
		trans.SetFailureHandlingOptions(foptions)
		createdSubRegions = []
		chopped = insubregions[:groupnum]
		del insubregions[:groupnum]
		total = len(insubregions)
		subtran = SubTransaction(doc)
		for i in chopped:
			subtran.Start()
			x = CurveLoop()
			for j in i:
				x.Append(j)
			curveLoops.append(x)
			y = [x]
			yI = List[CurveLoop](y)
			if SiteSubRegion.IsValidBoundary(yI):
				try:
					newSubRegion = SiteSubRegion.Create(doc, yI, host.Id)
					createdSubRegions.append(newSubRegion)
					subtran.Commit()
				except:
					subtran.RollBack()
					error.append("ERROR")
			else:
				subtran.RollBack()
				error.append("ERROR")
		trans.Commit()
		results.append(createdSubRegions)
	tGroup.Assimilate()
	
	OUT = flatten(results)
else:
	OUT = "Nothing to Do"
# ----------------------------------------
VARSubregions = Output(python_script)
