# Dynamo custom node Surface Importer.dyf (Dynamo 2.1.0.7500)
# category: Synthesize.Automate.Surface
# Surface Importer Node

VARSurfaces = Input(VARSurfaces: var[]..[])
count = List.Count(list=VARSurfaces)
code_block = CodeBlock { 1; }
eq = count == code_block
code_block_2 = CodeBlock { null; }
area = Surface.Area(surface=VARSurfaces@L2)
maximumItem = List.MaximumItem(list=area)
eq_2 = area == maximumItem
filterByBoolMask = List.FilterByBoolMask(list=VARSurfaces, mask=eq_2)
create = List.Create(item0=filterByBoolMask.in)
perimeterCurves = Surface.PerimeterCurves(surface=VARSurfaces@L2)
as_polycurve_bycurves = Custom[AS.[&] PolyCurve.ByCurves](VARcurves=perimeterCurves@L3)  # Create polycurves from an unordered list of curves.
flatten = List.Flatten(list=as_polycurve_bycurves.VARpolyCurve@L3)
trimWithEdgeLoops = Surface.TrimWithEdgeLoops(loops=flatten, lacing=Longest)  # unwired: surface
map = List.Map(list=create, f_x=trimWithEdgeLoops)
flatten_2 = List.Flatten(list=VARSurfaces)
isNull = Object.IsNull(obj=map)
flatten_3 = List.Flatten(list=isNull@L2)
matchLength = Custom[LF.List.MatchLength](VARlistLength=VARSurfaces, VARlist=flatten_3)  # Cycle a list to match the length of the first list.
flatten_4 = List.Flatten(list=matchLength)
filterByBoolMask_2 = List.FilterByBoolMask(list=flatten_2, mask=flatten_4)
create_2 = List.Create(item0=map, item1=filterByBoolMask_2.in)
code_block_3 = CodeBlock { null; false; }
clean = List.Clean(list=create_2, preserveIndices=code_block_3.out1)
flatten_5 = List.Flatten(list=clean)
create_3 = List.Create(item0=flatten_5)
byJoinedSurfaces = PolySurface.ByJoinedSurfaces()  # unwired: surfaces
map_2 = List.Map(list=create_3, f_x=byJoinedSurfaces)
code_block_4 = CodeBlock { false; }
clean_2 = List.Clean(list=map_2, preserveIndices=code_block_4)
flatten_6 = List.Flatten(list=clean_2)
uniqueItems = List.UniqueItems(list=flatten_6)
scopeIf = Custom[CW.ScopeIf+](VARtest=eq, VARtrue=code_block_2, VARfalse=uniqueItems)  # A (hopefully) more robust implementation of ScopeIf. Tests a single boolean and returns a value accordingly.
firstItem = List.FirstItem(list=uniqueItems)
turnIntoList = Custom[CW.TurnIntoList](VARunknownItem=firstItem)  # Turns an element (or a nested list) into a flat list
scopeIf_2 = Custom[CW.ScopeIf+](VARtest=eq, VARtrue=turnIntoList, VARfalse=code_block_2)
create_4 = List.Create(item0=scopeIf, item1=scopeIf_2)
code_block_5 = CodeBlock { false; }
clean_3 = List.Clean(list=create_4, preserveIndices=code_block_5)
flatten_7 = List.Flatten(list=clean_3)
VAR = Output(flatten_7)  # "VAR:var[]..[]"
