# Dynamo custom node Surface Slicer.dyf (Dynamo 2.13.1.3887)
# category: Synthesize.Automate.Geometry
# Surface Slicer
# packages: Synthesize toolkit 12.5.1

code_block = CodeBlock { false; true; }
VARPointsDistance = Input(VARPointsDistance: var[]..[])
VARSurfaces = Input(VARSurfaces: var[]..[])
surface_importer = Custom[Surface Importer](VARSurfaces=VARSurfaces)  # package Synthesize toolkit; Surface Importer Node
surfaces = PolySurface.Surfaces(polySurface=surface_importer)
flatten = List.Flatten(list=surfaces)
code_block_2 = CodeBlock { false; }
join_adjacent_surfaces = Custom[Join Adjacent Surfaces](VARSurfaces=flatten, VARNormalsCheck=code_block_2)  # package Synthesize toolkit; Join Adjacent Surfaces
join = List.Join()  # unwired: list0, list1
VARIntersectingElements = Input(VARIntersectingElements: var[]..[])
turnIntoList = Custom[CW.TurnIntoList](VARunknownItem=VARIntersectingElements)  # package Synthesize toolkit; Turns an element (or a nested list) into a flat list
geometry_and_vector_of_model = Custom[Geometry and Vector of Model Curves and Curve By Points](VARElements=turnIntoList)  # package Synthesize toolkit; Geometry and Vector of Model Curves and Curve By Points
python_all_elements_in_active = Custom[Python All Elements In Active View]()  # package Synthesize toolkit; Python All Elements In Active View
batch_elements_bounding_box = Custom[Batch Elements Bounding Box](VARElements=python_all_elements_in_active)  # package Synthesize toolkit; Batch Elements Bounding Box
maxPoint = BoundingBox.MaxPoint(boundingBox=batch_elements_bounding_box)
minPoint = BoundingBox.MinPoint(boundingBox=batch_elements_bounding_box)
byStartPointEndPoint = Line.ByStartPointEndPoint(startPoint=maxPoint, endPoint=minPoint)
length = Curve.Length(curve=byStartPointEndPoint)
code_block_3 = CodeBlock(a=length) { a*-1; }
extrude = Curve.Extrude(curve=geometry_and_vector_of_model.VARCurves, direction=geometry_and_vector_of_model.VARVectors, distance=code_block_3)
extrude_2 = Curve.Extrude(curve=geometry_and_vector_of_model.VARCurves, direction=geometry_and_vector_of_model.VARVectors, distance=length)
combine = List.Combine(comb=join, list1=extrude, list2=extrude_2)
code_block_4 = CodeBlock { false; }
join_adjacent_surfaces_2 = Custom[Join Adjacent Surfaces](VARSurfaces=combine@L2, VARNormalsCheck=code_block_4)
flatten_2 = List.Flatten(list=join_adjacent_surfaces_2)
filter_adaptive_component = Custom[Filter Adaptive Component FamilyInstances](VARFamilyInstances=turnIntoList)  # package Synthesize toolkit; Filter Adaptive Component FamilyInstances
curves = Element.Curves(element=filter_adaptive_component)
isNull = Object.IsNull(object=curves@L2)
allTrue = List.AllTrue(list=isNull@L2)
filterByBoolMask = List.FilterByBoolMask(list=filter_adaptive_component, mask=allTrue)
geometry = Element.Geometry(element=filterByBoolMask.out)
code_block_5 = CodeBlock { "Point"; "Solid"; "Surface"; }
byClassName = Custom[SP.Filter.ByClassName](VARobject=geometry, VARclassName=code_block_5.out0)  # package Synthesize toolkit; Filters a list of objects by the object's class name. Note that Dynamo elements belong to different classes than their Revit counterparts. Use the Object.Class node to check an object's class.
byClassName_2 = Custom[SP.Filter.ByClassName](VARobject=byClassName.VARout, VARclassName=code_block_5.out1)
byClassName_3 = Custom[SP.Filter.ByClassName](VARobject=byClassName_2.VARout, VARclassName=code_block_5.out2)
byBestFitThroughPoints = Plane.ByBestFitThroughPoints(points=byClassName.VARin)
normal = Plane.Normal(plane=byBestFitThroughPoints)
extrude_3 = Curve.Extrude(curve=byClassName_3.VARout, direction=normal, distance=code_block_3)
extrude_4 = Curve.Extrude(curve=byClassName_3.VARout, direction=normal, distance=length)
combine_2 = List.Combine(comb=join, list1=extrude_3, list2=extrude_4)
code_block_6 = CodeBlock { false; }
join_adjacent_surfaces_3 = Custom[Join Adjacent Surfaces](VARSurfaces=combine_2@L2, VARNormalsCheck=code_block_6)
flatten_3 = List.Flatten(list=join_adjacent_surfaces_3)
create = List.Create(item0=flatten_2, item1=flatten_3)
code_block_7 = CodeBlock { false; }
clean = List.Clean(list=create, preserveIndices=code_block_7)
flatten_4 = List.Flatten(list=clean)
python_script = Python(IN[0]=join_adjacent_surfaces, IN[1]=flatten_4)  # IronPython2
# ---------- python_script.python (51 lines) ----------
# Enable Python support and load DesignScript library
# IMPORTANT : ALL DYNAMO DESIGN SCRIPT NODES ARE AS (dg)
import clr
clr.AddReference('ProtoGeometry')
from Autodesk.DesignScript import Geometry as dg

# EXTENSION Enable ToDSType
clr.AddReference('RevitNodes')
import Revit
clr.ImportExtensions(Revit.Elements)

# Enable Revit Elements
from Revit.Elements import *

# EXTENSION Enable Geometry Conversion Methods
clr.ImportExtensions(Revit.GeometryConversion)

# Enable Revit API
clr.AddReference('RevitAPI')
from Autodesk.Revit.DB import *

# Enable DocumentManager and TransactionManager
clr.AddReference('RevitServices')
from RevitServices.Persistence import DocumentManager
from RevitServices.Transactions import TransactionManager

# Enable ICollection List Translate
clr.AddReference("System")
import System.Collections.Generic
from System.Collections.Generic import List

dataEnteringNode = IN
# Use UnwrapElement(IN[0]) When Translating From Dynamo to Revit
geoms=UnwrapElement(IN[0])
surfs=UnwrapElement(IN[1])

# Choose The Current Document
doc = DocumentManager.Instance.CurrentDBDocument
uidoc = DocumentManager.Instance.CurrentUIApplication.ActiveUIDocument
uiapp = DocumentManager.Instance.CurrentUIApplication
app = uiapp.Application

# Create Empty List
result = []

for g in geoms:
	for s in surfs:
		if dg.Geometry.DoesIntersect(g,s):
			result.append(dg.Geometry.Intersect(g,s))
# Assign your output to the OUT variable.
OUT = result
# ----------------------------------------
smooth_curves = Custom[Smooth Curves](VARForceClose=code_block.out0, VARPointsDistance=VARPointsDistance, VARCurves=python_script@@L1, VARSmoothMode=code_block.out1)  # package Synthesize toolkit; Smooth Curves
flatten_5 = List.Flatten(list=smooth_curves@L3)
as_polycurve_bycurves_with = Custom[AS.[&] PolyCurve.ByCurves With Failures](VARcurves=flatten_5)  # package Synthesize toolkit; Create polycurves from an unordered list of curves.
flatten_6 = List.Flatten(list=as_polycurve_bycurves_with.VARpolyCurve)
VARDepth = Input(VARDepth: var[]..[])
create_2 = List.Create(item0=normal, item1=geometry_and_vector_of_model.VARVectors)
code_block_8 = CodeBlock { false; }
clean_2 = List.Clean(list=create_2, preserveIndices=code_block_8)
flatten_7 = List.Flatten(list=clean_2)
firstItem = List.FirstItem(list=flatten_7)
byThickeningCurve = PolyCurve.ByThickeningCurve(curve=flatten_6, thickness=VARDepth, nor=firstItem)
byPatch = Surface.ByPatch(closedCurve=byThickeningCurve)
surface_laundry = Custom[Surface Laundry](VARSurfaceOrPolyCurvesList=byPatch)  # package Synthesize toolkit; Surface Laundry
VARWidth = Input(VARWidth: var[]..[])
VARUnionPieces = Input(VARUnionPieces: var[]..[])
VARThickenBothSides = Input(VARThickenBothSides: var[]..[])
python_script_2 = Python(IN[0]=surface_laundry, IN[1]=VARWidth, IN[2]=VARUnionPieces, IN[3]=VARThickenBothSides)  # IronPython2
# ---------- python_script_2.python (62 lines) ----------
# Enable Python support and load DesignScript library
# IMPORTANT : ALL DYNAMO DESIGN SCRIPT NODES ARE AS (dg)
import clr
clr.AddReference('ProtoGeometry')
from Autodesk.DesignScript import Geometry as dg

# EXTENSION Enable ToDSType
clr.AddReference('RevitNodes')
import Revit
clr.ImportExtensions(Revit.Elements)

# Enable Revit Elements
from Revit.Elements import *

# EXTENSION Enable Geometry Conversion Methods
clr.ImportExtensions(Revit.GeometryConversion)

# Enable Revit API
clr.AddReference('RevitAPI')
from Autodesk.Revit.DB import *

# Enable DocumentManager and TransactionManager
clr.AddReference('RevitServices')
from RevitServices.Persistence import DocumentManager
from RevitServices.Transactions import TransactionManager

# Enable ICollection List Translate
clr.AddReference("System")
import System.Collections.Generic
from System.Collections.Generic import List

dataEnteringNode = IN
# Use UnwrapElement(IN[0]) When Translating From Dynamo to Revit
surfs=UnwrapElement(IN[0])
thicken=IN[1]
forcejoin=IN[2]
bothsides=IN[3]
# Choose The Current Document
doc = DocumentManager.Instance.CurrentDBDocument
uidoc = DocumentManager.Instance.CurrentUIApplication.ActiveUIDocument
uiapp = DocumentManager.Instance.CurrentUIApplication
app = uiapp.Application

# Create Empty List
result = []

for s in surfs:
	try:
		result.append(dg.Surface.Thicken(s,thicken,bothsides))
	except:
		pass

if forcejoin == True:
	try:
		unioned = [dg.Solid.ByUnion(result)]
		for r in result:
			r.Dispose()
	except:
		unioned = result
	OUT = unioned
else:
	OUT = result
# ----------------------------------------
VARSolids = Output(python_script_2)
