# Dynamo custom node Surface.TangentAtVParameter Fixer.dyf (Dynamo 2.1.0.7500)
# category: Synthesize.Fixers
# Surface.TangentAtVParameter Fixer

VARSurface = Input(VARSurface: var[]..[])
VARdouble = Input(VARdouble: var[]..[])
tangentAtVParameter = Surface.TangentAtVParameter(surface=VARSurface, u=VARdouble, v=VARdouble)
VARVector = Output(tangentAtVParameter)
