# Dynamo custom node Surface.Thicken Fixer.dyf (Dynamo 2.1.0.7500)
# category: Synthesize.Fixers
# Surface.Thicken Fixer

VARsurface = Input(VARsurface: Autodesk.DesignScript.Geometry.Surface)
VARthickness = Input(VARthickness: double)
VARboth_sides = Input(VARboth_sides: bool)
thicken = Surface.Thicken(surface=VARsurface, thickness=VARthickness, both_sides=VARboth_sides)
VARSolid = Output(thicken)
