# Dynamo custom node Surfaces to Family or Imported.dyf (Dynamo 2.1.0.7500)
# category: Synthesize.Automate.Surface
# Surfaces to Family or Imported Face To Mass

VARSurfaceorSolid = Input(VARSurfaceorSolid: var[]..[])
flatten = List.Flatten(list=VARSurfaceorSolid)
count = List.Count(list=flatten)
code_block = CodeBlock { 0; }
ne = count != code_block
VARUpdateFamilyEvenIfAlreadyExists = Input(VARUpdateFamilyEvenIfAlreadyExists: bool = false)
code_block_2 = CodeBlock { null; true; }
VARPlaceInstanceEvenIfAlreadyPlaced = Input(VARPlaceInstanceEvenIfAlreadyPlaced: bool = false)
code_block_3 = CodeBlock { " "; }
join = String.Join(separator=code_block_3)  # unwired: string0, string1
VARFamilyName = Input(VARFamilyName: var)
VARMethodFalseIsImportedObjectTrueIsFami = Input(VARMethodFalseIsImportedObjectTrueIsFamily: var)
VAROneFamily = Input(VAROneFamily: bool = false)
code_block_4 = CodeBlock { false; }
scopeIf = Custom[CW.ScopeIf+](VARtest=VARMethodFalseIsImportedObjectTrueIsFami, VARtrue=VAROneFamily, VARfalse=code_block_4)  # A (hopefully) more robust implementation of ScopeIf. Tests a single boolean and returns a value accordingly.
code_block_5 = CodeBlock { 1; }
scopeIf_2 = Custom[CW.ScopeIf+](VARtest=scopeIf, VARtrue=code_block_5, VARfalse=flatten)
count_2 = List.Count(list=scopeIf_2)
cycle = List.Cycle(list=VARFamilyName, amount=count_2)
VARAutoSequenceNamingSuffix = Input(VARAutoSequenceNamingSuffix: bool = false)
code_block_6 = CodeBlock { "[0-9]+"; }
familyInstances = Custom[SP.Collector.FamilyInstances](VARinstnaceName=VARFamilyName)  # Collects placed family instance elements from the document that match the name. Partially mathing elements are collected as well. If no matches are found, a list of all isntance names will be output.
python_script = Python(IN[0]=familyInstances.VARpartialmatch)
# ---------- python_script.python (54 lines) ----------
# Enable Python support and load DesignScript library
# IMPORTANT : ALL DYNAMO DESIGN SCRIPT NODES ARE AS (dg)
import clr
clr.AddReference('ProtoGeometry')
from Autodesk.DesignScript import Geometry as dg

# EXTENSION Enable ToDSType
clr.AddReference('RevitNodes')
import Revit
clr.ImportExtensions(Revit.Elements)

# Enable Revit Elements
from Revit.Elements import *

# EXTENSION Enable Geometry Conversion Methods
clr.ImportExtensions(Revit.GeometryConversion)

# Enable Revit API
clr.AddReference('RevitAPI')
from Autodesk.Revit.DB import *

# Enable DocumentManager and TransactionManager
clr.AddReference('RevitServices')
from RevitServices.Persistence import DocumentManager
from RevitServices.Transactions import TransactionManager

# Enable ICollection List Translate
clr.AddReference("System")
import System.Collections.Generic
from System.Collections.Generic import List

dataEnteringNode = IN
# Use UnwrapElement(IN[0]) When Translating From Dynamo to Revit
elems=UnwrapElement(IN[0])

# Choose The Current Document
doc = DocumentManager.Instance.CurrentDBDocument
uidoc = DocumentManager.Instance.CurrentUIApplication.ActiveUIDocument
uiapp = DocumentManager.Instance.CurrentUIApplication
app = uiapp.Application

# Create Empty List
result = []
for each in elems:
	try:
		result.append(each.Name)
	except:
		pass

if len(result) == 0:
	result = None
	
# Assign your output to the OUT variable.
OUT = result
# ----------------------------------------
findRegularExpression = Custom[CW.String.FindRegularExpression](VARRegEx=code_block_6, VARstr=python_script)  # Returns all occurences of a regular expression within a string (or list of strings). The syntax for regular expressions is explained at http://ironpython-test.readthedocs.org/en/latest/howto/regex.html
python_script_2 = Python(IN[0]=findRegularExpression)
# ---------- python_script_2.python (66 lines) ----------
# Enable Python support and load DesignScript library
# IMPORTANT : ALL DYNAMO DESIGN SCRIPT NODES ARE AS (dg)
import clr
clr.AddReference('ProtoGeometry')
from Autodesk.DesignScript import Geometry as dg

# EXTENSION Enable ToDSType
clr.AddReference('RevitNodes')
import Revit
clr.ImportExtensions(Revit.Elements)

# Enable Revit Elements
from Revit.Elements import *

# EXTENSION Enable Geometry Conversion Methods
clr.ImportExtensions(Revit.GeometryConversion)

# Enable Revit API
clr.AddReference('RevitAPI')
from Autodesk.Revit.DB import *

# Enable DocumentManager and TransactionManager
clr.AddReference('RevitServices')
from RevitServices.Persistence import DocumentManager
from RevitServices.Transactions import TransactionManager

# Enable ICollection List Translate
clr.AddReference("System")
import System.Collections.Generic
from System.Collections.Generic import List

dataEnteringNode = IN
# Use UnwrapElement(IN[0]) When Translating From Dynamo to Revit
inside=UnwrapElement(IN[0])

# Choose The Current Document
doc = DocumentManager.Instance.CurrentDBDocument
uidoc = DocumentManager.Instance.CurrentUIApplication.ActiveUIDocument
uiapp = DocumentManager.Instance.CurrentUIApplication
app = uiapp.Application

def flatten(x):
    result = []
    for el in x:
        if hasattr(el, "__iter__") and not isinstance(el, basestring):
            result.extend(flatten(el))
        else:
            result.append(el)
    return result

# Create Empty List

try:
	result = flatten(inside)
	flresult = []
	for e in result:
		try:
			flresult.append(float(e))
		except: pass
	finalresult = sorted(flresult)
except:
	finalresult = []
	

# Assign your output to the OUT variable.
OUT = finalresult
# ----------------------------------------
list_lastitem_fixer = Custom[List.LastItem Fixer](VARlist=python_script_2)  # List.LastItem Fixer
code_block_7 = CodeBlock(a=list_lastitem_fixer) { a+1; }
isNull = Object.IsNull(obj=code_block_7)
code_block_8 = CodeBlock { 1; }
scopeIf_3 = Custom[CW.ScopeIf+](VARtest=isNull, VARtrue=code_block_8, VARfalse=code_block_7)
VARFamilyNumber = Input(VARFamilyNumber: double = 1)
scopeIf_4 = Custom[CW.ScopeIf+](VARtest=VARAutoSequenceNamingSuffix, VARtrue=scopeIf_3, VARfalse=VARFamilyNumber)
code_block_9 = CodeBlock { 1; }
sequence = Sequence(start=scopeIf_4, amount=count_2, step=code_block_9, lacing=Longest)
string_from_object = FromObject(obj=sequence)
code_block_10 = CodeBlock { "."; }
split = String.Split(str=string_from_object, separator0=code_block_10)
firstItem = List.FirstItem(list=split@L2)
combine = List.Combine(comb=join, list1=cycle, list2=firstItem)
familyInstances_2 = Custom[SP.Collector.FamilyInstances](VARinstnaceName=combine)
string_from_object_2 = FromObject(obj=familyInstances_2.VARexactmatch)
uniqueItems = List.UniqueItems(list=string_from_object_2)
string = StringInput("Nothing")
eq = uniqueItems == string
scopeIf_5 = Custom[CW.ScopeIf+](VARtest=VARPlaceInstanceEvenIfAlreadyPlaced, VARtrue=code_block_2.out1, VARfalse=eq)
scopeIf_6 = Custom[CW.ScopeIf+](VARtest=VARUpdateFamilyEvenIfAlreadyExists, VARtrue=code_block_2.out1, VARfalse=scopeIf_5)
string_2 = StringInput("Everything is Done")
string_3 = StringInput("""Please change the name of the Family, or the start sequence.
As there are similar names already exits in the project.""")
familyInstances_3 = Custom[SP.Collector.FamilyInstances](VARinstnaceName=cycle)
name = Family.Name(family=familyInstances_3.VARpartialmatch)
uniqueItems_2 = List.UniqueItems(list=name)
create = List.Create(item0=string_3, item1=uniqueItems_2)
scopeIf_7 = Custom[CW.ScopeIf+](VARtest=scopeIf_6, VARtrue=string_2, VARfalse=create)
code_block_11 = CodeBlock { "Form Failed"; }
scopeIf_8 = Custom[CW.ScopeIf+](VARtest=ne, VARtrue=scopeIf_7, VARfalse=code_block_11)
VARReport = Output(scopeIf_8)
scopeIf_9 = Custom[CW.ScopeIf+](VARtest=scopeIf_6, VARtrue=VARSurfaceorSolid, VARfalse=code_block_2.out0)
flatten_2 = List.Flatten(list=scopeIf_9)
code_block_12 = CodeBlock { 1; }
chop = List.Chop(list=flatten_2, lengths=code_block_12)
code_block_13 = CodeBlock { null; false; }
scopeIf_10 = Custom[CW.ScopeIf+](VARtest=VARMethodFalseIsImportedObjectTrueIsFami, VARtrue=chop, VARfalse=code_block_13.out0)
clean = List.Clean(list=scopeIf_10, preserveIndices=code_block_13.out1)
flatten_3 = List.Flatten(list=clean)
VARFamilyTemplate = Input(VARFamilyTemplate: var)
VARFamilyCategory = Input(VARFamilyCategory: var = Revit.Elements.Category.ByName("OST_GenericModel"))
passthrough = Custom[CW.Passthrough](VARpassThrough=VARFamilyCategory, VARwaitFor=familyInstances_2.VARexactmatch)  # Forces a sequential order of execution. The node wired into the output of the Passthrough node will be executed *after* the node wired into the waitFor input (e.g. important for some Revit operations). The value of the passThrough input will be passed on to the node wired into the output port of the Passthrough node.
VARmaterialName = Input(VARmaterialName: var = null)
VARIsVoid = Input(VARIsVoid: bool = false)
VARsubcategoryName = Input(VARsubcategoryName: var = null)
VARisShared = Input(VARisShared: bool = false)
VARPositioningSystemFalseIsInstanceOrigi = Input(VARPositioningSystemFalseIsInstanceOriginTrueIsRelativeToProjectOrigin: bool = false)
VARonemat = Input(VARonemat: bool = false)
VARIsInstanceMat = Input(VARIsInstanceMat: bool = true)
byGeometry = Custom[SP.FamilyInstance.ByGeometry](VARgeometry=flatten_3, VARfamilyTemplatePath=VARFamilyTemplate, VARfamilyName=combine, VARcategory=passthrough, VARmaterialName=VARmaterialName, VARisVoid=VARIsVoid, VARsubcategoryName=VARsubcategoryName, VARisShared=VARisShared, VARPlaceInstance=scopeIf_5, VARPositionSystemFalseIsInstanceOriginTrueRelativeToProjectOrigin=VARPositioningSystemFalseIsInstanceOrigi, VARonemat=VARonemat, VARIsInstanceMat=VARIsInstanceMat)  # You must provide a valid family template path that will be used for all input geometry objects. The project units(and not the templates) will be used to determine the size of the output geometry. The provided category will be used only if the family template supports it. If not, the default template category will be used instead. Likewise, the family material(provided as a string) will be set only if a material with that name exists in the template. If not, the default material will be used instead ("By Category"). For void cuts, the material settings will be ignored. The Subcategory name is an optional input. If you'd like to skip assigning a Subcategory to any new instance, simply use null. The node expects a unique family name for each geometry object. The rest of the input lists will be processed as if the node lacing is set to longest.
VARInElement = Output(byGeometry.VARinstance)
VARInFamily = Output(byGeometry.VARfamily)
clean_2 = List.Clean(list=flatten, preserveIndices=code_block_13.out1)
flatten_4 = List.Flatten(list=clean_2)
python_script_3 = Python(IN[0]=flatten_4, IN[1]=VAROneFamily, IN[2]=VARMethodFalseIsImportedObjectTrueIsFami)
# ---------- python_script_3.python (59 lines) ----------
# Enable Python support and load DesignScript library
# IMPORTANT : ALL DYNAMO DESIGN SCRIPT NODES ARE AS (dg)
import clr
clr.AddReference('ProtoGeometry')
from Autodesk.DesignScript import Geometry as dg

# EXTENSION Enable ToDSType
clr.AddReference('RevitNodes')
import Revit
clr.ImportExtensions(Revit.Elements)

# Enable Revit Elements
from Revit.Elements import *

# EXTENSION Enable Geometry Conversion Methods
clr.ImportExtensions(Revit.GeometryConversion)

# Enable Revit API
clr.AddReference('RevitAPI')
from Autodesk.Revit.DB import *

# Enable DocumentManager and TransactionManager
clr.AddReference('RevitServices')
from RevitServices.Persistence import DocumentManager
from RevitServices.Transactions import TransactionManager

# Enable ICollection List Translate
clr.AddReference("System")
import System.Collections.Generic
from System.Collections.Generic import List
from System import Array
dataEnteringNode = IN
# Use UnwrapElement(IN[0]) When Translating From Dynamo to Revit
geoms=UnwrapElement(IN[0])
onefam = IN[1]
toggle = IN[2]

# Choose The Current Document
doc = DocumentManager.Instance.CurrentDBDocument
uidoc = DocumentManager.Instance.CurrentUIApplication.ActiveUIDocument
uiapp = DocumentManager.Instance.CurrentUIApplication
app = uiapp.Application

# Create Empty List
result = []
newresult = []
if toggle == False:
	newlist = Array[dg.Geometry](geoms)
	if onefam == False:
		for each in newlist:
			result.append(Revit.Elements.ImportInstance.ByGeometry(each))
	else:
		result.append(Revit.Elements.ImportInstance.ByGeometries(newlist))

	for e in result:
		newresult.append(UnwrapElement(e).ToDSType(False))

#Assign your output to the OUT variable.
OUT = newresult
# ----------------------------------------
clean_3 = List.Clean(list=python_script_3, preserveIndices=code_block_13.out1)
flatten_5 = List.Flatten(list=clean_3)
VARImported = Output(flatten_5)
families_with_similar_names = Watch(familyInstances_2.VARexactmatch)
string_from_object_3 = FromObject(obj=scopeIf_4)
code_block_14 = CodeBlock { "."; }
split_2 = String.Split(str=string_from_object_3, separator0=code_block_14)
firstItem_2 = List.FirstItem(list=split_2@L2)
toNumber = String.ToNumber(str=firstItem_2)
firstItem_3 = List.FirstItem(list=toNumber)
VARStartSequenceNamingSuffix = Output(firstItem_3)
