# Dynamo custom node Topography Pull Lines Onto Topo.dyf (Dynamo 2.1.0.7500)
# category: Synthesize.Automate.Topography
# Topography Pull Lines Onto Topo

VARTopography = Input(VARTopography: var[]..[])
code_block = CodeBlock { true; }
polySurface = Custom[ZK.Topography.PolySurface](VARTopography=VARTopography, VARFullTopo=code_block)  # Convert topography element to polysurface
VARCurves = Input(VARCurves: var[]..[])
curves = Element.Curves()  # unwired: element
map = List.Map(list=VARCurves, f_x=curves)
flatten = List.Flatten(list=map)
as_polycurve_bycurves = Custom[AS.[&] PolyCurve.ByCurves](VARcurves=flatten)  # Create polycurves from an unordered list of curves.
byGeometry = BoundingBox.ByGeometry(geom=polySurface.VARPolySurface)
minPoint = BoundingBox.MinPoint(boundingBox=byGeometry)
Z = Point.Z(point=minPoint)
byCoordinates = Point.ByCoordinates(z=Z)
byOriginNormal = Plane.ByOriginNormal(origin=byCoordinates)
pullOntoPlane = Curve.PullOntoPlane(curve=as_polycurve_bycurves.VARpolyCurve, plane=byOriginNormal)
code_block_2 = CodeBlock { false; }
clean = List.Clean(list=pullOntoPlane, preserveIndices=code_block_2)
ZAxis = Vector.ZAxis()
maxPoint = BoundingBox.MaxPoint(boundingBox=byGeometry)
Z_2 = Point.Z(point=maxPoint)
sub = Z_2 - Z
extrude = Curve.Extrude(curve=clean, direction=ZAxis, distance=sub)
intersect = Geometry.Intersect(geometry=polySurface.VARPolySurface, other=extrude, lacing=CrossProduct)
code_block_3 = CodeBlock { "Point"; }
byClassName = Custom[SP.Filter.ByClassName](VARobject=intersect, VARclassName=code_block_3)  # Filters a list of objects by the object's class name. Note that Dynamo elements belong to different classes than their Revit counterparts. Use the Object.Class node to check an object's class.
code_block_4 = CodeBlock { false; }
clean_2 = List.Clean(list=byClassName.VARout, preserveIndices=code_block_4)
flatten_2 = List.Flatten(list=clean_2)
code_block_5 = CodeBlock { false; }
clean_3 = List.Clean(list=flatten_2, preserveIndices=code_block_5)
flatten_3 = List.Flatten(list=clean_3)
code_block_6 = CodeBlock { 1; }
chop = List.Chop(list=flatten_3, lengths=code_block_6)
code_block_7 = CodeBlock { 0; }
curves_offset_to_revit = Custom[Curves Offset To Revit Compatibility](VARCurves=chop, VAROffset=code_block_7)  # Curves Offset To Revit Compatibility
flatten_4 = List.Flatten(list=curves_offset_to_revit.VARCurves)
byCurve = ModelCurve.ByCurve(curve=flatten_4)
VARModelCurve = Output(byCurve)
VARNumberofControlPointsDesired = Input(VARNumberofControlPointsDesired: var[]..[])
