# Dynamo custom node Topography Split Unlock.dyf (Dynamo 2.1.0.7500)
# category: Synthesize.Automate.Topography
# Topography Split Allow

VARProceedOnlyAfteryoucopiedtheselectede = Input(VARProceedOnlyAfteryoucopiedtheselectedelementsfromfirstplay: var[]..[])
code_block = CodeBlock { null; }
categories = Categories("OST_Topography")
all_elements_of_category = ElementsOfCategory(Category=categories)
VARTopography = Input(VARTopography: var[]..[])
contains = List.Contains(list=all_elements_of_category@L1, item=VARTopography, lacing=CrossProduct)
flatten = List.Flatten(list=contains)
filterByBoolMask = List.FilterByBoolMask(list=all_elements_of_category, mask=flatten)
scopeIf = Custom[CW.ScopeIf+](VARtest=VARProceedOnlyAfteryoucopiedtheselectede, VARtrue=code_block, VARfalse=filterByBoolMask.out)  # A (hopefully) more robust implementation of ScopeIf. Tests a single boolean and returns a value accordingly.
hot_select_in_revit = Custom[HOT.Select in Revit](VARElement=scopeIf)  # Select Elements in Revit
VARSelectedResult = Output(hot_select_in_revit)
points = Topography.Points(topography=VARTopography)
code_block_2 = CodeBlock { null; false; }
scopeIf_2 = Custom[CW.ScopeIf+](VARtest=VARProceedOnlyAfteryoucopiedtheselectede, VARtrue=points, VARfalse=code_block_2.out0)
clean = List.Clean(list=scopeIf_2, preserveIndices=code_block_2.out1)
create = List.Create(item0=clean)
byPoints = Topography.ByPoints()  # unwired: points
map = List.Map(list=create, f_x=byPoints)
code_block_3 = CodeBlock { "Phase Created"; "Phase Demolished"; "Material"; "Name"; "Comments"; "Mark"; "Image"; }
create_2 = List.Create(item0=code_block_3.out0, item1=code_block_3.out1, item2=code_block_3.out2, item3=code_block_3.out3, item4=code_block_3.out4, item5=code_block_3.out5, item6=code_block_3.out6)
getParameterValueByName = Element.GetParameterValueByName(element=VARTopography, parameterName=create_2)
setParameterByName = Element.SetParameterByName(parameterName=create_2, value=getParameterValueByName)  # unwired: element
map_2 = List.Map(list=map, f_x=setParameterByName)
passthrough = Custom[CW.Passthrough](VARpassThrough=VARProceedOnlyAfteryoucopiedtheselectede, VARwaitFor=map_2)  # Forces a sequential order of execution. The node wired into the output of the Passthrough node will be executed *after* the node wired into the waitFor input (e.g. important for some Revit operations). The value of the passThrough input will be passed on to the node wired into the output port of the Passthrough node.
passthrough_2 = Custom[CW.Passthrough](VARpassThrough=VARTopography, VARwaitFor=map_2)
code_block_4 = CodeBlock { null; }
passthrough_3 = Custom[CW.Passthrough](VARpassThrough=code_block_4, VARwaitFor=map_2)
scopeIf_3 = Custom[CW.ScopeIf+](VARtest=passthrough, VARtrue=passthrough_2, VARfalse=passthrough_3)
eraser = Custom[ST.Tool.Eraser](VARList=scopeIf_3)  # Try to delete any element from project
VARCantdeleteIds = Output(eraser)
VARTopology = Output(map)
