# Dynamo custom node Topography Water.dyf (Dynamo 2.1.0.7500)
# category: Synthesize.Automate.Topography
# Topography Water

VARWaterBoundary = Input(VARWaterBoundary: var[]..[])
flatten = List.Flatten(list=VARWaterBoundary)
code_block = CodeBlock { 0; }
VARWaterLevel = Input(VARWaterLevel: var[]..[])
projectElevation = Level.ProjectElevation(level=VARWaterLevel)
byCoordinates = Point.ByCoordinates(x=code_block, y=code_block, z=projectElevation)
ZAxis = Vector.ZAxis()
byOriginNormal = Plane.ByOriginNormal(origin=byCoordinates, normal=ZAxis)
VARWaterDepth = Input(VARWaterDepth: var[]..[])
code_block_2 = CodeBlock { -2; }
div = VARWaterDepth / code_block_2
offset = Plane.Offset(plane=byOriginNormal, dist=div)
pullOntoPlane = Curve.PullOntoPlane(curve=flatten, plane=offset)
patch = Curve.Patch(curve=pullOntoPlane)
thicken = Surface.Thicken(surface=patch, thickness=VARWaterDepth)
VARTopographyPolysurface = Input(VARTopographyPolysurface: var[]..[])
as_geometry_splitbytools = Custom[AS.[&] Geometry.SplitByTools](VARgeometry=thicken, VARtools=VARTopographyPolysurface)  # Split one piece of geometry (other than a polysurface) by multiple tools
flatten_2 = List.Flatten(list=as_geometry_splitbytools)
byGeometry = BoundingBox.ByGeometry(geom=flatten_2, lacing=Longest)
minPoint = BoundingBox.MinPoint(boundingBox=byGeometry)
Z = Point.Z(point=minPoint)
as_list_sortbykey = Custom[AS.[&] List.SortByKey](VARlist=flatten_2, VARkeys=Z)  # Sort a list (or lists) according to the order specified by the key list.
lastItem = List.LastItem(list=as_list_sortbykey.VARsortedlist)
VARSolid = Output(lastItem)
explode = Geometry.Explode(geometry=lastItem)
filterByOrientation = Custom[CW.Surface.FilterByOrientation](VARsurfaces=explode)  # Sorts surfaces in three lists based on their orientation (vertical, horizontal up & horizontal down) and also returns three corresponding lists of booleans.
flatten_3 = List.Flatten(list=filterByOrientation.VARhorizontalUp)
perimeterCurves = Surface.PerimeterCurves(surface=flatten_3)
python_script = Python(IN[0]=perimeterCurves)
# ---------- python_script.python (21 lines) ----------
# Load the Python Standard and DesignScript Libraries
import sys
import clr
clr.AddReference('ProtoGeometry')
from Autodesk.DesignScript.Geometry import *

# The inputs to this node will be stored as a list in the IN variables.
dataEnteringNode = IN

# Place your code below this line
list = IN[0]

result = []
error = []
for l in list:
	try:
		result.append(PolyCurve.ByJoinedCurves(l))
	except:
		error.append(l)
# Assign your output to the OUT variable.
OUT = result,error
# ----------------------------------------
code_block_3 = CodeBlock(a=python_script) { a[0]; a[1]; }
as_polycurve_bycurves = Custom[AS.[&] PolyCurve.ByCurves](VARcurves=code_block_3.out1)  # Create polycurves from an unordered list of curves.
create = List.Create(item0=as_polycurve_bycurves.VARpolyCurve, item1=code_block_3.out0)
code_block_4 = CodeBlock { false; }
clean = List.Clean(list=create, preserveIndices=code_block_4)
flatten_4 = List.Flatten(list=clean)
curves = PolyCurve.Curves(polyCurve=flatten_4)
curves_offset_to_revit = Custom[Curves Offset To Revit Compatibility](VARCurves=curves)  # Curves Offset To Revit Compatibility
VARBuildSubregionBellowWateer = Input(VARBuildSubregionBellowWateer: var[]..[])
VARTopography = Input(VARTopography: var[]..[])
empty = List.Empty()
scopeIf = Custom[CW.ScopeIf+](VARtest=VARBuildSubregionBellowWateer, VARtrue=VARTopography, VARfalse=empty)  # A (hopefully) more robust implementation of ScopeIf. Tests a single boolean and returns a value accordingly.
subregions_batch_create = Custom[Subregions Batch Create](VARRevitCurves=curves_offset_to_revit.VARRevitCurves, VARTopography=scopeIf)  # Subregions Batch Create
