# Dynamo custom node UV In All Directions.dyf (Dynamo 2.1.0.7500)
# category: Synthesize.Automate.Adaptive
# UV In All Directions

VARDirection1234 = Input(VARDirection1234: var[]..[])
code_block = CodeBlock { 1; 2; 3; 4; null; }
eq = VARDirection1234 == code_block.out0
VARUNumber = Input(VARUNumber: var[]..[])
VARVNumber = Input(VARVNumber: var[]..[])
code_block_2 = CodeBlock(u=VARUNumber, v=VARVNumber) { 0..1..#u; 0..1..#v; }
create = List.Create(item0=code_block_2.out0, item1=code_block_2.out1)
scopeIf = Custom[CW.ScopeIf+](VARtest=eq, VARtrue=create, VARfalse=code_block.out4)  # A (hopefully) more robust implementation of ScopeIf. Tests a single boolean and returns a value accordingly.
eq_2 = VARDirection1234 == code_block.out1
code_block_3 = CodeBlock(u=VARUNumber, v=VARVNumber) { 0..1..#u; 1..0..#v; }
create_2 = List.Create(item0=code_block_3.out0, item1=code_block_3.out1)
scopeIf_2 = Custom[CW.ScopeIf+](VARtest=eq_2, VARtrue=create_2, VARfalse=code_block.out4)
eq_3 = VARDirection1234 == code_block.out2
code_block_4 = CodeBlock(u=VARUNumber, v=VARVNumber) { 1..0..#u; 1..0..#v; }
create_3 = List.Create(item0=code_block_4.out0, item1=code_block_4.out1)
scopeIf_3 = Custom[CW.ScopeIf+](VARtest=eq_3, VARtrue=create_3, VARfalse=code_block.out4)
eq_4 = VARDirection1234 == code_block.out3
code_block_5 = CodeBlock(u=VARUNumber, v=VARVNumber) { 1..0..#u; 0..1..#v; }
create_4 = List.Create(item0=code_block_5.out0, item1=code_block_5.out1)
scopeIf_4 = Custom[CW.ScopeIf+](VARtest=eq_4, VARtrue=create_4, VARfalse=code_block.out4)
create_5 = List.Create(item0=scopeIf, item1=scopeIf_2, item2=scopeIf_3, item3=scopeIf_4)
code_block_6 = CodeBlock { false; }
clean = List.Clean(list=create_5, preserveIndices=code_block_6)
code_block_7 = CodeBlock(a=clean, b=clean) { a[0][0]; b[0][1]; }
VARU = Output(code_block_7.out0)
VARV = Output(code_block_7.out1)
