# Dynamo custom node UV Management Intersects Function.dyf (Dynamo 2.1.0.7500)
# category: Synthesize.Automate.Lines
# UV Management Intersects Function

VARElements = Input(VARElements: var[]..[])
VARIntersects = Input(VARIntersects: var[]..[])
VARDrawIntersectsToggle = Input(VARDrawIntersectsToggle: var[]..[])
python_script = Python(IN[0]=VARElements, IN[1]=VARIntersects, IN[2]=VARDrawIntersectsToggle)
# ---------- python_script.python (123 lines) ----------
# Enable Python support and load DesignScript library
# IMPORTANT : ALL DYNAMO DESIGN SCRIPT NODES ARE AS (dg)
import clr
clr.AddReference('ProtoGeometry')
from Autodesk.DesignScript import Geometry as dg

# EXTENSION Enable ToDSType
clr.AddReference('RevitNodes')
import Revit
clr.ImportExtensions(Revit.Elements)

# Enable Revit Elements
from Revit.Elements import *

# EXTENSION Enable Geometry Conversion Methods
clr.ImportExtensions(Revit.GeometryConversion)

# Enable Revit API
clr.AddReference('RevitAPI')
from Autodesk.Revit.DB import *

# Enable DocumentManager and TransactionManager
clr.AddReference('RevitServices')
from RevitServices.Persistence import DocumentManager
from RevitServices.Transactions import TransactionManager

# Enable ICollection List Translate
clr.AddReference("System")
import System.Collections.Generic
from System.Collections.Generic import List

dataEnteringNode = IN
# Use UnwrapElement(IN[0]) When Translating From Dynamo to Revit
masses=UnwrapElement(IN[0])
intersects = UnwrapElement(IN[1])
toggleonoff = IN[2]

# Choose The Current Document
doc = DocumentManager.Instance.CurrentDBDocument
uidoc = DocumentManager.Instance.CurrentUIApplication.ActiveUIDocument
uiapp = DocumentManager.Instance.CurrentUIApplication
app = uiapp.Application

class WarnSwallow(IFailuresPreprocessor):
	def PreprocessFailures(self, failuresAccessor):
		failuresAccessor.DeleteAllWarnings()
		return FailureProcessingResult.Continue

def flatten(x):
    result = []
    for el in x:
        if hasattr(el, "__iter__") and not isinstance(el, basestring):
            result.extend(flatten(el))
        else:
            result.append(el)
    return result
# Create Empty List
result = []

if toggleonoff == True:
	TransactionManager.Instance.EnsureInTransaction(doc)

	famtypeitr = []

	for each in masses:
		famtypeitr.append(each.Id)
 
	for item in famtypeitr:
		typeID = item
		srfObj = doc.GetElement(typeID)
 
    	#Get Geometry Elements
		geOptions = app.Create.NewGeometryOptions()
		geOptions.ComputeReferences = True
		geoElem = srfObj.get_Geometry(geOptions)
		tmpmeasure = []
		for es in geoElem:
			tmpmeasure.append(es)
		if len(tmpmeasure) == 1:
			tmplist = []
			for e in geoElem:
				if e.ToString() == "Autodesk.Revit.DB.GeometryInstance":
					tmplist.append(e.GetSymbolGeometry())
			if len(tmplist) == 0:
				tmplist = geoElem
			flat = flatten(tmplist)
			geoElem = flat
		#For each geometry object in geometry elements
		for geObj in geoElem:
			try:
				for face in geObj.Faces:
					divSrf = DividedSurface.GetDividedSurfaceForReference(doc,face.Reference)
					if divSrf == None:
						divSrf = DividedSurface.Create(doc,face.Reference)
						result.append(divSrf)
						srfU = divSrf.USpacingRule
						srfU.SetLayoutNone()
						srfV = divSrf.VSpacingRule
						srfV.SetLayoutNone()
					else:
						result.append(divSrf)
			except: pass

	divsurf = result

	count = 0
	for each in divsurf:
		try:
			alreadyexisted = each.GetAllIntersectionElements()
			each.RemoveAllIntersectionElements()
			for ii in alreadyexisted:
				doc.Delete(ii)
		except: pass
		try:
			for e in intersects[count]:
				each.AddIntersectionElement(e.Id)
		except: pass
		count = count + 1

	# End the Transaction with Current Document ()
	TransactionManager.Instance.TransactionTaskDone()

OUT = result
# ----------------------------------------
VARDividedSurface = Output(python_script)
