# Dynamo custom node UV Management Loft - Updater.dyf (Dynamo 2.1.0.7500)
# category: Synthesize.Automate.Loft
# UV Management Loft - Updater

hot_get_all_filter = Custom[HOT.Get All Filter]()  # Get all Filter
string_from_object = FromObject(obj=hot_get_all_filter.VARElement)
code_block = CodeBlock { "SelectionFilterElement"; }
eq = string_from_object == code_block
filterByBoolMask = List.FilterByBoolMask(list=hot_get_all_filter.VARElement, mask=eq)
elements = Custom[CW.SelectionSet.Elements](VARselectionSet=filterByBoolMask.in)  # Retrieves all elements stored in a selection set
isEmpty = List.IsEmpty(list=elements, lacing=Longest)
filterByBoolMask_2 = List.FilterByBoolMask(list=filterByBoolMask.in, mask=isEmpty)
python_all_elements_in_active = Custom[Python All Elements In Active View]()  # Python All Elements In Active View
elements_2 = Custom[CW.SelectionSet.Elements](VARselectionSet=filterByBoolMask_2.out)
contains = List.Contains(list=python_all_elements_in_active, item=elements_2@@L1)
anyTrue = Custom[CW.List.AnyTrue](VARseq=contains)  # Returns true if any item in a list of booleans is true.
filterByBoolMask_3 = List.FilterByBoolMask(list=filterByBoolMask_2.out, mask=anyTrue)
filterByBoolMask_4 = List.FilterByBoolMask(list=hot_get_all_filter.VARName, mask=eq)
filterByBoolMask_5 = List.FilterByBoolMask(list=filterByBoolMask_4.in, mask=isEmpty)
filterByBoolMask_6 = List.FilterByBoolMask(list=filterByBoolMask_5.out, mask=anyTrue)
code_block_2 = CodeBlock { "DONOTDELETE-Dynamo UV Management Loft"; }
contains_2 = String.Contains(str=filterByBoolMask_6.in, searchFor=code_block_2)
filterByBoolMask_7 = List.FilterByBoolMask(list=filterByBoolMask_3.in, mask=contains_2)
elements_3 = Custom[CW.SelectionSet.Elements](VARselectionSet=filterByBoolMask_7.in)
isEmpty_2 = List.IsEmpty(list=elements_3, lacing=Longest)
filterByBoolMask_8 = List.FilterByBoolMask(list=filterByBoolMask_7.in, mask=isEmpty_2)
filterByBoolMask_9 = List.FilterByBoolMask(list=filterByBoolMask_6.in, mask=contains_2)
filterByBoolMask_10 = List.FilterByBoolMask(list=filterByBoolMask_9.in, mask=isEmpty_2)
code_block_3 = CodeBlock { ","; }
split = String.Split(str=filterByBoolMask_10.out, separator0=code_block_3)
lastItem = List.LastItem(list=split@L2)
code_block_4 = CodeBlock { "-"; }
split_2 = String.Split(str=lastItem, separator0=code_block_4)
toNumber = String.ToNumber(str=split_2)
python_script = Python(IN[0]=toNumber)
# ---------- python_script.python (80 lines) ----------
# Enable Python support and load DesignScript library
# IMPORTANT : ALL DYNAMO DESIGN SCRIPT NODES ARE AS (dg)
import clr
clr.AddReference('ProtoGeometry')
from Autodesk.DesignScript import Geometry as dg

# EXTENSION Enable ToDSType
clr.AddReference('RevitNodes')
import Revit
clr.ImportExtensions(Revit.Elements)

# Enable Revit Elements
from Revit.Elements import *

# EXTENSION Enable Geometry Conversion Methods
clr.ImportExtensions(Revit.GeometryConversion)

# Enable Revit API
clr.AddReference('RevitAPI')
from Autodesk.Revit.DB import *

# Enable DocumentManager and TransactionManager
clr.AddReference('RevitServices')
from RevitServices.Persistence import DocumentManager
from RevitServices.Transactions import TransactionManager

# Enable ICollection List Translate
clr.AddReference("System")
import System.Collections.Generic
from System.Collections.Generic import List

def ElementById(item, doc):
	try: 
		return doc.GetElement(item).ToDSType(True)
	except:
		try:
			return doc.GetElement(ElementId(item)).ToDSType(True)
		except:
			return None

dataEnteringNode = IN
# Use UnwrapElement(IN[0]) When Translating From Dynamo to Revit
lists=UnwrapElement(IN[0])

# Choose The Current Document
doc = DocumentManager.Instance.CurrentDBDocument
uidoc = DocumentManager.Instance.CurrentUIApplication.ActiveUIDocument
uiapp = DocumentManager.Instance.CurrentUIApplication
app = uiapp.Application

# Create Empty List
result = []

elements = [x for x in FilteredElementCollector(doc).OfClass(FamilyInstance).ToElements()]
comments = []
for e in elements:
	try:
		comments.append(e.get_Parameter(BuiltInParameter.ALL_MODEL_INSTANCE_COMMENTS).AsString())
	except:
		comments.append(None)

for l in lists:
	tmp = []
	for n in l:
		tryget = ElementById(n, doc)
		if tryget == None:
			count = 0
			wanted = None
			for c in comments:
				if str(n) == c:
					wanted = elements[count]
					break
				count += 1
			tmp.append(wanted)
		else:
			tmp.append(tryget)
	result.append(tmp)

# Assign your output to the OUT variable.
OUT = result
# ----------------------------------------
isNull = Object.IsNull(obj=python_script)
anyFalse = Custom[CW.List.AnyFalse](VARseq=isNull)  # Returns true if any item in a list of booleans is false.
filterByBoolMask_11 = List.FilterByBoolMask(list=filterByBoolMask_8.out, mask=anyFalse)
filterByBoolMask_12 = List.FilterByBoolMask(list=split, mask=anyFalse)
code_block_5 = CodeBlock { 1; }
getItemAtIndex = List.GetItemAtIndex(list=filterByBoolMask_12.in@L2, index=code_block_5)
as_list_groupbykey = Custom[AS.[&] List.GroupByKey](VARobjectList=filterByBoolMask_11.in, VARkeys=getItemAtIndex)  # Sort the items of a list into groups (sublists) based on the corresponding items of a reference list. Example: The list {A,B,C,D,E} with the reference list {1,anyWord,4,anyWord,1} will be grouped into lists as { {A,E}, {B,D}, {C} } and the unique references will be {1, anyWord, 4}.
filterByBoolMask_13 = List.FilterByBoolMask(list=filterByBoolMask_10.out, mask=anyFalse)
as_list_groupbykey_2 = Custom[AS.[&] List.GroupByKey](VARobjectList=filterByBoolMask_13.in, VARkeys=getItemAtIndex)
code_block_6 = CodeBlock { "Profiles"; }
contains_3 = String.Contains(str=as_list_groupbykey_2.VARgroups, searchFor=code_block_6)
anyTrue_2 = Custom[CW.List.AnyTrue](VARseq=contains_3)
filterByBoolMask_14 = List.FilterByBoolMask(list=as_list_groupbykey.VARgroups, mask=anyTrue_2)
eraser = Custom[ST.Tool.Eraser](VARList=filterByBoolMask_14.out)  # Try to delete any element from project
VARCustomSmoothMode = Input(VARCustomSmoothMode: var[]..[])
VARCustomSmoothModeSmoothModeForceSmooth = Input(VARCustomSmoothModeSmoothModeForceSmoothClosedLoopsProfiles: var[]..[])
filterByBoolMask_15 = List.FilterByBoolMask(list=as_list_groupbykey_2.VARgroups, mask=anyTrue_2)
firstItem = List.FirstItem(list=filterByBoolMask_15.in@L2)
elements_4 = Custom[CW.SelectionSet.Elements](VARselectionSet=filterByBoolMask_14.in@@L2)
filterByBoolMask_16 = List.FilterByBoolMask(list=elements_4, mask=contains_3)
python_empty_2_null = Custom[Python Empty 2 Null](VARIN=filterByBoolMask_16.in)  # Python Null 2 Empty
rank = List.Rank(list=python_empty_2_null)
normalizeDepth = List.NormalizeDepth(list=python_empty_2_null, rank=rank)
flatten = List.Flatten(list=normalizeDepth@L2)
geometry_of_model_curves_and = Custom[Geometry of Model Curves and Curve By Points](VARElements=flatten@L2)  # Geometry and Vector of Model Curves and Curve By Points
isNull_2 = Object.IsNull(obj=geometry_of_model_curves_and)
allTrue = List.AllTrue(list=isNull_2@L2)
filterByBoolMask_17 = List.FilterByBoolMask(list=firstItem, mask=allTrue)
split_3 = String.Split(str=filterByBoolMask_17.out, separator0=code_block_3)
code_block_7 = CodeBlock { "X1"; ":"; "X2"; '\'; }
replace = String.Replace(str=split_3, searchFor=code_block_7.out0, replaceWith=code_block_7.out1)
replace_2 = String.Replace(str=replace, searchFor=code_block_7.out2, replaceWith=code_block_7.out3)
python_script_2 = Python(IN[0]=replace_2)
# ---------- python_script_2.python (28 lines) ----------
import clr
clr.AddReference('ProtoGeometry')
from Autodesk.DesignScript.Geometry import *
#The inputs to this node will be stored as a list in the IN variables.
dataEnteringNode = IN

inside = UnwrapElement(IN[0])

result = []

for each in inside:
	tmplist = []
	for e in each:
		try:
			tmplist.append(int(e))
		except:
			try:
				if e == "f":
					tmplist.append(False)
				elif e == "t":
					tmplist.append(True)
				else:
					tmplist.append(e)
			except:
				pass
	result.append(tmplist)
#Assign your output to the OUT variable.
OUT = result
# ----------------------------------------
count = List.Count(list=python_script_2)
cycle = List.Cycle(list=VARCustomSmoothModeSmoothModeForceSmooth, amount=count)
transpose = List.Transpose(lists=python_script_2)
code_block_8 = CodeBlock { 2; }
dropItems = List.DropItems(list=transpose, amount=code_block_8)
code_block_9 = CodeBlock(a=dropItems)
# ---------- code_block_9.designscript (35 lines) ----------
a[0];
a[1];
a[2];
a[3];
a[4];
a[5];
a[6];
a[7];
a[8];
a[9];
a[10];
a[11];
a[12];
a[13];
a[14];
a[15];
a[16];
a[17];
a[18];
a[19];
a[20];
a[21];
a[22];
a[23];
a[24];
a[25];
a[26];
a[27];
a[28];
a[29];
a[30];
a[31];
a[32];
a[33];
a[34];
# ----------------------------------------
scopeIf = Custom[CW.ScopeIf+](VARtest=VARCustomSmoothMode, VARtrue=cycle, VARfalse=code_block_9.out5)  # A (hopefully) more robust implementation of ScopeIf. Tests a single boolean and returns a value accordingly.
VARCustomSmoothModeSmoothModePointsDista = Input(VARCustomSmoothModeSmoothModePointsDistancingProfiles: var[]..[])
cycle_2 = List.Cycle(list=VARCustomSmoothModeSmoothModePointsDista, amount=count)
scopeIf_2 = Custom[CW.ScopeIf+](VARtest=VARCustomSmoothMode, VARtrue=cycle_2, VARfalse=code_block_9.out6)
VARCustomSmoothModeSmoothModeProfiles = Input(VARCustomSmoothModeSmoothModeProfiles: var[]..[])
cycle_3 = List.Cycle(list=VARCustomSmoothModeSmoothModeProfiles, amount=count)
scopeIf_3 = Custom[CW.ScopeIf+](VARtest=VARCustomSmoothMode, VARtrue=cycle_3, VARfalse=code_block_9.out4)
VARCustomGuidesBehaviour = Input(VARCustomGuidesBehaviour: var[]..[])
VARCustomGuidesBehaviourLoopMode = Input(VARCustomGuidesBehaviourLoopMode: var[]..[])
cycle_4 = List.Cycle(list=VARCustomGuidesBehaviourLoopMode, amount=count)
scopeIf_4 = Custom[CW.ScopeIf+](VARtest=VARCustomGuidesBehaviour, VARtrue=cycle_4, VARfalse=code_block_9.out3)
VARCustomGuidesBehaviourGuidesAsRail = Input(VARCustomGuidesBehaviourGuidesAsRail: var[]..[])
cycle_5 = List.Cycle(list=VARCustomGuidesBehaviourGuidesAsRail, amount=count)
scopeIf_5 = Custom[CW.ScopeIf+](VARtest=VARCustomGuidesBehaviour, VARtrue=cycle_5, VARfalse=code_block_9.out2)
VARCustomOffsets = Input(VARCustomOffsets: var[]..[])
VARCustomOffsetsProfilesOffsetCopy = Input(VARCustomOffsetsProfilesOffsetCopy: var[]..[])
cycle_6 = List.Cycle(list=VARCustomOffsetsProfilesOffsetCopy, amount=count)
scopeIf_6 = Custom[CW.ScopeIf+](VARtest=VARCustomOffsets, VARtrue=cycle_6, VARfalse=code_block_9.out0)
filterByBoolMask_18 = List.FilterByBoolMask(list=geometry_of_model_curves_and, mask=allTrue)
code_block_10 = CodeBlock { false; }
clean = List.Clean(list=filterByBoolMask_18.out, preserveIndices=code_block_10)
VARCustomSmoothModeSmoothModeForceSmooth_2 = Input(VARCustomSmoothModeSmoothModeForceSmoothClosedLoopsGuides: var[]..[])
cycle_7 = List.Cycle(list=VARCustomSmoothModeSmoothModeForceSmooth_2, amount=count)
scopeIf_7 = Custom[CW.ScopeIf+](VARtest=VARCustomSmoothMode, VARtrue=cycle_7, VARfalse=code_block_9.out8)
VARCustomSmoothModeSmoothModePointsDista_2 = Input(VARCustomSmoothModeSmoothModePointsDistancingGuides: var[]..[])
cycle_8 = List.Cycle(list=VARCustomSmoothModeSmoothModePointsDista_2, amount=count)
scopeIf_8 = Custom[CW.ScopeIf+](VARtest=VARCustomSmoothMode, VARtrue=cycle_8, VARfalse=code_block_9.out9)
VARCustomSmoothModeSmoothModeGuides = Input(VARCustomSmoothModeSmoothModeGuides: var[]..[])
cycle_9 = List.Cycle(list=VARCustomSmoothModeSmoothModeGuides, amount=count)
scopeIf_9 = Custom[CW.ScopeIf+](VARtest=VARCustomSmoothMode, VARtrue=cycle_9, VARfalse=code_block_9.out7)
python_empty_2_null_2 = Custom[Python Empty 2 Null](VARIN=filterByBoolMask_16.out)
rank_2 = List.Rank(list=python_empty_2_null_2)
normalizeDepth_2 = List.NormalizeDepth(list=python_empty_2_null_2, rank=rank_2)
flatten_2 = List.Flatten(list=normalizeDepth_2@L2)
geometry_of_model_curves_and_2 = Custom[Geometry of Model Curves and Curve By Points](VARElements=flatten_2@L2)
filterByBoolMask_19 = List.FilterByBoolMask(list=geometry_of_model_curves_and_2, mask=allTrue)
VARCustomIntersects = Input(VARCustomIntersects: var[]..[])
VARCustomIntersectsDrawIntersects = Input(VARCustomIntersectsDrawIntersects: var[]..[])
cycle_10 = List.Cycle(list=VARCustomIntersectsDrawIntersects, amount=count)
scopeIf_10 = Custom[CW.ScopeIf+](VARtest=VARCustomIntersects, VARtrue=cycle_10, VARfalse=code_block_9.out25)
VARCustomIntersectsU = Input(VARCustomIntersectsU: var[]..[])
cycle_11 = List.Cycle(list=VARCustomIntersectsU, amount=count)
scopeIf_11 = Custom[CW.ScopeIf+](VARtest=VARCustomIntersects, VARtrue=cycle_11, VARfalse=code_block_9.out26)
VARCustomIntersectsV = Input(VARCustomIntersectsV: var[]..[])
cycle_12 = List.Cycle(list=VARCustomIntersectsV, amount=count)
scopeIf_12 = Custom[CW.ScopeIf+](VARtest=VARCustomIntersects, VARtrue=cycle_12, VARfalse=code_block_9.out27)
VARCustomIntersectsIntersectsNumberofCon = Input(VARCustomIntersectsIntersectsNumberofControlPointsPerIntersectingLine: var[]..[])
cycle_13 = List.Cycle(list=VARCustomIntersectsIntersectsNumberofCon, amount=count)
scopeIf_13 = Custom[CW.ScopeIf+](VARtest=VARCustomIntersects, VARtrue=cycle_13, VARfalse=code_block_9.out28)
VARCustomIntersectsIntersectsExtendDista = Input(VARCustomIntersectsIntersectsExtendDistance: var[]..[])
cycle_14 = List.Cycle(list=VARCustomIntersectsIntersectsExtendDista, amount=count)
scopeIf_14 = Custom[CW.ScopeIf+](VARtest=VARCustomIntersects, VARtrue=cycle_14, VARfalse=code_block_9.out29)
VARCustomIntersectsIntersectsIntersectsR = Input(VARCustomIntersectsIntersectsIntersectsReferencePlanesOffsetFromFace: var[]..[])
cycle_15 = List.Cycle(list=VARCustomIntersectsIntersectsIntersectsR, amount=count)
scopeIf_15 = Custom[CW.ScopeIf+](VARtest=VARCustomIntersects, VARtrue=cycle_15, VARfalse=code_block_9.out31)
VARCustomIntersectsIntersectsReferencePl = Input(VARCustomIntersectsIntersectsReferencePlanesNamePreFix: var[]..[])
cycle_16 = List.Cycle(list=VARCustomIntersectsIntersectsReferencePl, amount=count)
scopeIf_16 = Custom[CW.ScopeIf+](VARtest=VARCustomIntersects, VARtrue=cycle_16, VARfalse=code_block_9.out30)
VARCustomIntersectsIntersectsFlipReferen = Input(VARCustomIntersectsIntersectsFlipReferencePlanesSide: var[]..[])
cycle_17 = List.Cycle(list=VARCustomIntersectsIntersectsFlipReferen, amount=count)
scopeIf_17 = Custom[CW.ScopeIf+](VARtest=VARCustomIntersects, VARtrue=cycle_17, VARfalse=code_block_9.out32)
string_from_object_2 = FromObject(obj=code_block_9.out20)
code_block_11 = CodeBlock { "."; }
split_4 = String.Split(str=string_from_object_2, separator0=code_block_11)
firstItem_2 = List.FirstItem(list=split_4@L2)
toNumber_2 = String.ToNumber(str=firstItem_2)
VARCustomFamilyTemplate = Input(VARCustomFamilyTemplate: var[]..[])
VARCustomFamilyTemplateFalseImportedObje = Input(VARCustomFamilyTemplateFalseImportedObjectTrueFamily: var[]..[])
cycle_18 = List.Cycle(list=VARCustomFamilyTemplateFalseImportedObje, amount=count)
scopeIf_18 = Custom[CW.ScopeIf+](VARtest=VARCustomFamilyTemplate, VARtrue=cycle_18, VARfalse=code_block_9.out11)
VARCustomFamilyTemplateFamilyTemplateofT = Input(VARCustomFamilyTemplateFamilyTemplateofTheUsedCategory: var[]..[])
cycle_19 = List.Cycle(list=VARCustomFamilyTemplateFamilyTemplateofT, amount=count)
scopeIf_19 = Custom[CW.ScopeIf+](VARtest=VARCustomFamilyTemplate, VARtrue=cycle_19, VARfalse=code_block_9.out24)
smart_rft_path = Custom[Smart RFT Path](VARRFTFile=scopeIf_19@L1, VARCategory=code_block_9.out22@L1)  # Smart RFT Path
VARExportToSAT = Input(VARExportToSAT: var[]..[])
cycle_20 = List.Cycle(list=VARExportToSAT, amount=count)
VARSATExportPath = Input(VARSATExportPath: var[]..[])
python_script_3 = Python(IN[0]=firstItem_2, IN[1]=VARSATExportPath)
# ---------- python_script_3.python (16 lines) ----------
import clr
clr.AddReference('ProtoGeometry')
from Autodesk.DesignScript.Geometry import *
#The inputs to this node will be stored as a list in the IN variables.
dataEnteringNode = IN

nums = IN[0]
fullname = IN[1]

result =[]

for each in nums:
	result.append(fullname[:-4] + " " + each + ".sat")

#Assign your output to the OUT variable.
OUT = result
# ----------------------------------------
VARCustomOffsetsGuidesOffset = Input(VARCustomOffsetsGuidesOffset: var[]..[])
cycle_21 = List.Cycle(list=VARCustomOffsetsGuidesOffset, amount=count)
scopeIf_20 = Custom[CW.ScopeIf+](VARtest=VARCustomOffsets, VARtrue=cycle_21, VARfalse=code_block_9.out1)
trimWhitespace = String.TrimWhitespace(str=code_block_9.out21)
trimWhitespace_2 = String.TrimWhitespace(str=code_block_9.out23)
uv_management_loft = Custom[UV Management Loft](VARForceCloseProfiles=scopeIf, VARPointsDistanceProfiles=scopeIf_2, VARSmoothModeProfiles=scopeIf_3, VARLoopMode=scopeIf_4, VARGuidesasRails=scopeIf_5, VAROffsetProfiles=scopeIf_6, VARProfiles=clean, VARForceCloseGuides=scopeIf_7, VARPointsDistanceGuides=scopeIf_8, VARSmoothModeGuides=scopeIf_9, VARGuides=filterByBoolMask_19.out, VARImportToRevit=code_block_9.out10, VARDrawIntersects=scopeIf_10, VARU=scopeIf_11, VARV=scopeIf_12, VARNumberofControlPointsPerLine=scopeIf_13, VARExtraExtendedDistance=scopeIf_14, VARReferencePlanesOffset=scopeIf_15, VARReferencePlaneNamePrefix=scopeIf_16, VARFlipReferencePlanesSide=scopeIf_17, VARFamilyName=code_block_9.out18, VARStartSequenceNamingSuffix=toNumber_2, VARFamilyCategory=code_block_9.out22, VARMethodFalseIsImportedObjectTrueIsFamily=scopeIf_18, VARFamilyTemplate=smart_rft_path, VARIsVoid=code_block_9.out17, VAROneFamily=code_block_9.out15, VARisShared=code_block_9.out16, VARExportSAT=cycle_20, VARSATFilepath=python_script_3, VAROffsetGuides=scopeIf_20, VARPlaceInstaceEvenIfAlreadyPlaced=code_block_9.out13, VARPositionSystemFalseIsInstanceOriginTrueIsRelativeToProjectOrigin=code_block_9.out14, VARmaterialName=trimWhitespace, VARsubcategoryName=trimWhitespace_2, VARUpdateFamilyEvenIfAlreadyExists=code_block_9.out12, VARAutoSequenceNamingSuffix=code_block_9.out19, lacing=Longest)  # UV Management Loft
VARRevitImportReport = Output(uv_management_loft.VARRevitImportReport)
VARReferencePoints = Output(uv_management_loft.VARReferencePoints)
VARElements = Output(uv_management_loft.VARRElements)
VARSATExport = Output(uv_management_loft.VARSATExport)
VARFamily = Output(uv_management_loft.VARFamily)
uv_management_intersects = Custom[UV Management Intersects Function](VARElements=uv_management_loft.VARToIntesectElements, VARIntersects=uv_management_loft.VARToIntesectLines, VARDrawIntersectsToggle=scopeIf_10, lacing=Longest)  # UV Management Intersects Function
VARDividedSurface = Output(uv_management_intersects)
eraser_2 = Custom[ST.Tool.Eraser](VARList=filterByBoolMask_11.out)
eraser_3 = Custom[ST.Tool.Eraser](VARList=filterByBoolMask_8.in)
code_block_12 = CodeBlock(e=dropItems) { e[35]; }
byID = Custom[CW.Element.ByID](VARIDUniqueId=code_block_12)  # Gets the Revit element(s) for a list of IDs (or a single ID). Optionally retrieves elements from linked documents as well.
VAROldElements = Output(byID)
VARTMPFilters = Output(filterByBoolMask_17.out)
VARTMPMethod = Output(code_block_9.out11)
eraser_4 = Custom[ST.Tool.Eraser](VARList=filterByBoolMask_2.in)
