# Dynamo custom node UV Management Nurbs Curve Function.dyf (Dynamo 2.1.0.7500)
# category: Synthesize.Automate.Lines
# UV Management Nurbs Curve Function

VARCurves = Input(VARCurves: var[]..[])
code_block = CodeBlock { false; }
clean = List.Clean(list=VARCurves, preserveIndices=code_block)
flatten = List.Flatten(list=clean)
as_polycurve_bycurves = Custom[AS.[&] PolyCurve.ByCurves](VARcurves=flatten)  # Create polycurves from an unordered list of curves.
isClosed = Curve.IsClosed(curve=as_polycurve_bycurves.VARpolyCurve)
filterByBoolMask = List.FilterByBoolMask(list=as_polycurve_bycurves.VARpolyCurve, mask=isClosed)
curves = PolyCurve.Curves(polyCurve=filterByBoolMask.out)
explode = Geometry.Explode(geometry=curves)
flatten_2 = List.Flatten(list=explode)
VARSplinesDegree = Input(VARSplinesDegree: var[]..[])
VARSmoothProfiles = Input(VARSmoothProfiles: var[]..[])
VARControlPointsDistancing = Input(VARControlPointsDistancing: var[]..[])
VARSmoothlyCloseProfiles = Input(VARSmoothlyCloseProfiles: var[]..[])
nurbs_curves_re_creation = Custom[Nurbs Curves Re-Creation](VARCurves=flatten_2, VARSplinesDegree=VARSplinesDegree, VARSmoothProfiles=VARSmoothProfiles, VARControlPointsDistancing=VARControlPointsDistancing, VARSmoothlyCloseProfile=VARSmoothlyCloseProfiles)  # Nurbs Curves Re-Creation
code_block_2 = CodeBlock { false; }
clean_2 = List.Clean(list=nurbs_curves_re_creation, preserveIndices=code_block_2)
curves_2 = PolyCurve.Curves(polyCurve=filterByBoolMask.in)
explode_2 = Geometry.Explode(geometry=curves_2)
flatten_3 = List.Flatten(list=explode_2@L3)
string_from_object = FromObject(obj=flatten_3)
code_block_3 = CodeBlock { "NurbsCurve(Degree = 3)"; }
eq = string_from_object == code_block_3
filterByBoolMask_2 = List.FilterByBoolMask(list=flatten_3, mask=eq)
code_block_4 = CodeBlock { false; }
clean_3 = List.Clean(list=filterByBoolMask_2.out, preserveIndices=code_block_4)
code_block_5 = CodeBlock { true; }
nurbs_curves_re_creation_2 = Custom[Nurbs Curves Re-Creation](VARCurves=clean_3, VARSplinesDegree=VARSplinesDegree, VARSmoothProfiles=VARSmoothProfiles, VARControlPointsDistancing=VARControlPointsDistancing, VARSmoothlyCloseProfile=code_block_5)
code_block_6 = CodeBlock { false; }
clean_4 = List.Clean(list=nurbs_curves_re_creation_2, preserveIndices=code_block_6)
clean_5 = List.Clean(list=filterByBoolMask_2.in, preserveIndices=code_block_4)
code_block_7 = CodeBlock { true; }
nurbs_curves_re_creation_3 = Custom[Nurbs Curves Re-Creation](VARCurves=clean_5, VARSplinesDegree=VARSplinesDegree, VARSmoothProfiles=code_block_7, VARControlPointsDistancing=VARControlPointsDistancing, VARSmoothlyCloseProfile=code_block_5)
code_block_8 = CodeBlock { false; }
clean_6 = List.Clean(list=nurbs_curves_re_creation_3, preserveIndices=code_block_8)
create = List.Create(item0=clean_2, item1=clean_4, item2=clean_6)
code_block_9 = CodeBlock { false; }
clean_7 = List.Clean(list=create, preserveIndices=code_block_9)
flatten_4 = List.Flatten(list=clean_7)
VARNurbsCurve = Output(flatten_4)
