# Dynamo custom node UV Management.dyf (Dynamo 2.1.0.7500)
# category: Synthesize.Automate.Loft
# UV Management

VARAutomaticPointsNumberDetectionFalsefo = Input(VARAutomaticPointsNumberDetectionFalseforCustom: var[]..[])
code_block = CodeBlock { "[0-9]+"; }
element_types = ElementTypes("ReferencePoint")
all_elements_of_type = ElementsOfType(element_type=element_types)
code_block_2 = CodeBlock { "Name"; }
getParameterValueByName = Element.GetParameterValueByName(element=all_elements_of_type, parameterName=code_block_2)
code_block_3 = CodeBlock { ""; }
eq = getParameterValueByName == code_block_3
filterByBoolMask = List.FilterByBoolMask(list=getParameterValueByName, mask=eq)
findRegularExpression = Custom[CW.String.FindRegularExpression](VARRegEx=code_block, VARstr=filterByBoolMask.out)  # Returns all occurences of a regular expression within a string (or list of strings). The syntax for regular expressions is explained at http://ironpython-test.readthedocs.org/en/latest/howto/regex.html
flatten = List.Flatten(list=findRegularExpression)
toNumber = String.ToNumber(str=flatten)
uniqueItems = List.UniqueItems(list=toNumber)
sort = List.Sort(list=uniqueItems)
list_lastitem_fixer = Custom[List.LastItem Fixer](VARlist=sort)  # List.LastItem Fixer
code_block_4 = CodeBlock { 1; }
add = list_lastitem_fixer + code_block_4
isNull = Object.IsNull(obj=add)
code_block_5 = CodeBlock { 1; }
scopeIf = Custom[CW.ScopeIf+](VARtest=isNull, VARtrue=code_block_5, VARfalse=add)  # A (hopefully) more robust implementation of ScopeIf. Tests a single boolean and returns a value accordingly.
VARCustomPointNameNumberingSequenceStart = Input(VARCustomPointNameNumberingSequenceStart: var[]..[])
scopeIf_2 = Custom[CW.ScopeIf+](VARtest=VARAutomaticPointsNumberDetectionFalsefo, VARtrue=scopeIf, VARfalse=VARCustomPointNameNumberingSequenceStart)
VARDivideByU = Input(VARDivideByU: var[]..[] = FalseDivideByV = True;)
VARVGrid = Input(VARVGrid: var[]..[])
VARUGrid = Input(VARUGrid: var[]..[])
VARImporttoRevit = Input(VARImporttoRevit: var[]..[])
VARParametricU = Input(VARParametricU: var[]..[])
VARParametricV = Input(VARParametricV: var[]..[])
code_block_6 = CodeBlock { true; }
VARNurbsSurfaces = Input(VARNurbsSurfaces: var[]..[])
VARMassFamilyName = Input(VARMassFamilyName: var[]..[])
VARStartSequenceNamingSuffix = Input(VARStartSequenceNamingSuffix: var[]..[])
VARConceptualMassTemplate = Input(VARConceptualMassTemplate: var[]..[])
VARMethodFalse = Input(VARMethodFalse: var[]..[] = ImportedObjectTrue = MassFamily;)
VARSurfaceorSolid = Input(VARSurfaceorSolid: var[]..[])
VARCategory = Input(VARCategory: var[]..[])
dynaform_generate_points_from = Custom[DynaForm Generate Points From Surface](VARDivideByU=VARDivideByU, VARVGrid=VARVGrid, VARUGrid=VARUGrid, VARImporttoRevit=VARImporttoRevit, VARParametricU=VARParametricU, VARParametricV=VARParametricV, VARSmoothMode=code_block_6, VARNurbsSurfaces=VARNurbsSurfaces, VARMassFamilyName=VARMassFamilyName, VARStartSequenceNamingSuffix=VARStartSequenceNamingSuffix, VARConceptualMassTemplate=VARConceptualMassTemplate, VARMethodFalse=VARMethodFalse, VARSurfaceorSolid=VARSurfaceorSolid, VARCategory=VARCategory)  # Generate UV Grid From Surface
VARPlacePoints = Input(VARPlacePoints: var[]..[])
generate_t_sequenced_points = Custom[Generate T-Sequenced Points](VARNumberSequenceStart=scopeIf_2, VARPoints=dynaform_generate_points_from.VARPoints, VARPlacePoints=VARPlacePoints, VARSurface=dynaform_generate_points_from.VARNurbsSurfaces)  # Generate T-Sequenced Points
VARLastPointName = Output(generate_t_sequenced_points.VARLastPointName)
VARNumberofPoints = Output(generate_t_sequenced_points.VARNumberofPoints)
VARFamilyMethodReport = Output(dynaform_generate_points_from.VARFamilyMethodReport)
VARCreateSelectionFilter = Input(VARCreateSelectionFilter: var[]..[])
VARFilterNametoCreate = Input(VARFilterNametoCreate: var[]..[])
VAROverwriteExistingFilter = Input(VAROverwriteExistingFilter: var[]..[])
VARNumberofControlPointsPerLine = Input(VARNumberofControlPointsPerLine: var[]..[])
VARDrawLines = Input(VARDrawLines: var[]..[])
VARExtraExtendedDistance = Input(VARExtraExtendedDistance: var[]..[])
VARLinesWithPoints = Input(VARLinesWithPoints: var[]..[])
VARReferencePlanesOffset = Input(VARReferencePlanesOffset: var[]..[])
VARReferencePlaneNamePrefix = Input(VARReferencePlaneNamePrefix: var[]..[])
VARFlipReferencePlanesSide = Input(VARFlipReferencePlanesSide: var[]..[])
generate_t_lines = Custom[Generate T-Lines](VARCurves=dynaform_generate_points_from.VARCurves, VARUGrid=VARUGrid, VARVGrid=VARVGrid, VARNumberofControlPointsPerLine=VARNumberofControlPointsPerLine, VARDrawLines=VARDrawLines, VARExtraExtendedDistance=VARExtraExtendedDistance, VARLinesWithPoints=VARLinesWithPoints, VARFaces=dynaform_generate_points_from.VARNurbsSurfaces, VARReferencePlanesOffset=VARReferencePlanesOffset, VARReferencePlaneNamePrefix=VARReferencePlaneNamePrefix, VARFlipReferencePlanesSide=VARFlipReferencePlanesSide)  # Generate T-Lines
create = List.Create(item0=generate_t_sequenced_points.VARReferencePoints, item1=generate_t_lines.VARModelCurve, item2=dynaform_generate_points_from.VARImportInstance)
code_block_7 = CodeBlock { false; }
clean = List.Clean(list=create, preserveIndices=code_block_7)
generate_selection_filter = Custom[Generate Selection Filter](VARCreateSelectionFilter=VARCreateSelectionFilter, VARFilterNametoCreate=VARFilterNametoCreate, VAROverwriteExistingFilter=VAROverwriteExistingFilter, VARElements=clean)  # Generate Selection FIlter
flatten_2 = List.Flatten(list=generate_t_lines.VARReferencePoints)
code_block_8 = CodeBlock { "Offset"; 0; "Is Reference Line"; 1; }
setParameterByName = Element.SetParameterByName(element=flatten_2, parameterName=code_block_8.out0, value=code_block_8.out1)
code_block_9 = CodeBlock { null; false; }
scopeIf_3 = Custom[CW.ScopeIf+](VARtest=VARDrawLines, VARtrue=VARLinesWithPoints, VARfalse=code_block_9.out1)
scopeIf_4 = Custom[CW.ScopeIf+](VARtest=scopeIf_3, VARtrue=dynaform_generate_points_from.VARImportInstance, VARfalse=code_block_9.out0)
elementFaceReferences = Element.ElementFaceReferences(element=scopeIf_4)
flatten_3 = List.Flatten(list=elementFaceReferences)
code_block_10 = CodeBlock { 1; }
byFaceAndUVDivisions = DividedSurface.ByFaceAndUVDivisions(elementFace=flatten_3, uDivs=code_block_10, vDivs=code_block_10)
dividedsurface_without_layout = Custom[DividedSurface.Without Layout](VARDividedSurfaces=byFaceAndUVDivisions)  # DividedSurface.Without Layout
flatten_4 = List.Flatten(list=generate_t_lines.VARModelCurve)
addIntersect = Custom[CW.DividedSurface.AddIntersect](VARdividedSurface=dividedsurface_without_layout, VARelement=flatten_4)  # Adds an intersect to a divided surface
create_2 = List.Create(item0=generate_selection_filter.VARSelectionSet, item1=clean, item2=setParameterByName, item3=dynaform_generate_points_from.VARInElement, item4=dynaform_generate_points_from.VARInFamily, item5=generate_t_lines.VARReferencePlanes, item6=addIntersect)
code_block_11 = CodeBlock { false; }
clean_2 = List.Clean(list=create_2, preserveIndices=code_block_11)
flatten_5 = List.Flatten(list=clean_2)
VAROutput = Output(flatten_5)
flatten_6 = List.Flatten(list=generate_t_lines.VARModelCurve)
setParameterByName_2 = Element.SetParameterByName(element=flatten_6, parameterName=code_block_8.out2, value=code_block_8.out3)
code_block_12 = CodeBlock { 0; false; }
count = List.Count(list=dynaform_generate_points_from.VARPoints@L2)
count_2 = List.Count(list=count)
count_3 = List.Count(list=dynaform_generate_points_from.VARNurbsSurfaces)
div = count_2 / count_3
chop = List.Chop(list=dynaform_generate_points_from.VARPoints, lengths=div)
flatten_7 = List.Flatten(list=chop@L3)
coordinate_system_adaptive = Custom[Coordinate System Adaptive Surface Prepare](VARAdaptivePointsOffset=code_block_12.out0, VARPointsLists=flatten_7, VARSurfaces=dynaform_generate_points_from.VARNurbsSurfaces, VARFlip=code_block_12.out1)  # Coordinate System Adaptive Surface Prepare
flatten_8 = List.Flatten(list=coordinate_system_adaptive)
count_4 = List.Count(list=generate_t_sequenced_points.VARReferencePoints)
div_2 = count_4 / count_3
chop_2 = List.Chop(list=generate_t_sequenced_points.VARReferencePoints, lengths=div_2)
flatten_9 = List.Flatten(list=chop_2)
reference_point_orientation_fix = Custom[Reference Point Orientation Fix By Coordinate System](VARCoordinateSystem=flatten_8, VARReferencePoint=flatten_9)  # Reference Point By Coordinate System
