# Dynamo custom node Understand Faces.dyf (Dynamo 2.1.0.7500)
# category: Synthesize.Automate.Surface
# Try to Normalize Faces

VARUnderstandorNot = Input(VARUnderstandorNot: var[]..[])
VARSurfaces = Input(VARSurfaces: var[]..[])
empty = List.Empty()
scopeIf = Custom[CW.ScopeIf+](VARtest=VARUnderstandorNot, VARtrue=VARSurfaces, VARfalse=empty)  # A (hopefully) more robust implementation of ScopeIf. Tests a single boolean and returns a value accordingly.
flatten = List.Flatten(list=scopeIf)
perimeterCurves = Surface.PerimeterCurves(surface=flatten)
as_polycurve_bycurves = Custom[AS.[&] PolyCurve.ByCurves](VARcurves=perimeterCurves)  # Create polycurves from an unordered list of curves.
curves = PolyCurve.Curves(polyCurve=as_polycurve_bycurves.VARpolyCurve)
curves_offset_to_revit = Custom[Curves Offset To Revit Compatibility](VARCurves=curves@@L3)  # Curves Offset To Revit Compatibility
python_script = Python(IN[0]=curves_offset_to_revit.VARCurves)
# ---------- python_script.python (105 lines) ----------
# Enable Python support and load DesignScript library
# IMPORTANT : ALL DYNAMO DESIGN SCRIPT NODES ARE AS (dg)
import clr
clr.AddReference('ProtoGeometry')
from Autodesk.DesignScript import Geometry as dg

# EXTENSION Enable ToDSType
clr.AddReference('RevitNodes')
import Revit
clr.ImportExtensions(Revit.Elements)

# Enable Revit Elements
from Revit.Elements import *

# EXTENSION Enable Geometry Conversion Methods
clr.ImportExtensions(Revit.GeometryConversion)

# Enable Revit API
clr.AddReference('RevitAPI')
from Autodesk.Revit.DB import *

# Enable DocumentManager and TransactionManager
clr.AddReference('RevitServices')
from RevitServices.Persistence import DocumentManager
from RevitServices.Transactions import TransactionManager

# Enable ICollection List Translate
clr.AddReference("System")
import System.Collections.Generic
from System.Collections.Generic import List

dataEnteringNode = IN
# Use UnwrapElement(IN[0]) When Translating From Dynamo to Revit
curvesbig=UnwrapElement(IN[0])

# Choose The Current Document
doc = DocumentManager.Instance.CurrentDBDocument
uidoc = DocumentManager.Instance.CurrentUIApplication.ActiveUIDocument
uiapp = DocumentManager.Instance.CurrentUIApplication
app = uiapp.Application

# Create Empty List
result = []
result2 = []

for curves in curvesbig:
	tmpbig = []
	tmpbig2 = []
	for clist in curves:
		tmp = []
		for c in clist:
			if "Line" in c.ToRevitType().ToString():
				tmp.append(True)
			else:
				tmp.append(False)
		if all(tmp) or len(tmp) != 4:
			tmpbig.append(clist)
		else:
			try:
				try:
					tmpbig2.append(dg.Surface.ByLoft([clist[0],clist[2]],[clist[1],clist[3]]))
				except:
					try:
						tmpbig2.append(dg.Surface.ByLoft([clist[1],clist[3]],[clist[0],clist[2]]))
					except:
						try:
							areas = []
							surfat = []
							try:
								surf = dg.Surface.ByLoft([clist[1],clist[3]])
								areas.append(surf.Area)
								surfat.append(surf)
							except:
								pass
							try:
								surf2 = dg.Surface.ByLoft([clist[0],clist[2]])
								areas.append(surf2.Area)
								surfat.append(surf2)
							except:
								pass
							maxarea = max(areas)
							maxind = areas.index(maxarea)
							wantedsurf = surfat[maxind]
							bboxorg = dg.BoundingBox.ByGeometry(clist)
							bboxnew = dg.BoundingBox.ByGeometry(wantedsurf)
							minorg = bboxorg.MinPoint
							maxorg = bboxorg.MaxPoint
							midorg = dg.Curve.PointAtParameter(dg.Line.ByStartPointEndPoint(minorg,maxorg),0.5)
							minnew = bboxnew.MinPoint
							maxnew = bboxnew.MaxPoint
							midnew = dg.Curve.PointAtParameter(dg.Line.ByStartPointEndPoint(minnew,maxnew),0.5)
							dis = dg.Geometry.DistanceTo(midorg,midnew)
							if round(dis,1) == 0:
								tmpbig2.append(wantedsurf)
							else:
								tmp.append(False)
						except:
							tmp.append(False)
						
			except:
				tmp.append(False)
	result.append(tmpbig)
	result2.append(tmpbig2)
# Assign your output to the OUT variable.
OUT = result,result2
# ----------------------------------------
code_block = CodeBlock(a=python_script) { a[0]; }
count = List.Count(list=code_block@@L2)
VARsnappingTolerance = Input(VARsnappingTolerance: double = 0.001)
VARcreaseOuterVertices = Input(VARcreaseOuterVertices: bool)
code_block_2 = CodeBlock { true; }
buildFromLines = TSpline.TSplineSurface.BuildFromLines(lines=code_block, maxFaceValence=count, snappingTolerance=VARsnappingTolerance, creaseOuterVertices=VARcreaseOuterVertices, inSmoothMode=code_block_2)
code_block_3 = CodeBlock { false; }
toBRep = TSpline.TSplineSurface.ToBRep(tSplineSurface=buildFromLines, matchTopology=code_block_3)
byJoinedSurfaces = PolySurface.ByJoinedSurfaces(surfaces=toBRep)
surfaces = PolySurface.Surfaces(polySurface=byJoinedSurfaces)
toNurbsSurface = Surface.ToNurbsSurface(surface=surfaces)
code_block_4 = CodeBlock(a=python_script) { a[1]; }
isEmpty = List.IsEmpty(list=code_block, lacing=Longest)
filterByBoolMask = List.FilterByBoolMask(list=flatten, mask=isEmpty)
isNull = Object.IsNull(obj=toBRep)
allTrue = List.AllTrue(list=isNull@L2)
filterByBoolMask_2 = List.FilterByBoolMask(list=filterByBoolMask.out, mask=allTrue)
create = List.Create(item0=toNurbsSurface, item1=code_block_4, item2=filterByBoolMask_2.in)
code_block_5 = CodeBlock { false; }
clean = List.Clean(list=create, preserveIndices=code_block_5)
flatten_2 = List.Flatten(list=clean)
scopeIf_2 = Custom[CW.ScopeIf+](VARtest=VARUnderstandorNot, VARtrue=flatten_2, VARfalse=VARSurfaces)
VARNurbsSurface = Output(scopeIf_2)
