# Dynamo custom node Unjoin Elements (Smart).dyf (Dynamo 2.1.0.7500)
# category: Synthesize.Automate.Join
# Unjoin Elements (Smart)

VARUnjoinVisibleElementsinActiveViewOnly = Input(VARUnjoinVisibleElementsinActiveViewOnly: var[]..[])
VARListtoUnjoin = Input(VARListtoUnjoin: var[]..[])
flatten = List.Flatten(list=VARListtoUnjoin)
VARAllElementsinActiveView = Input(VARAllElementsinActiveView: var[]..[])
python_filter_list_from_another = Custom[Python Filter List From Another List](VARItemsToFilter=flatten, VARAllItemsToFilterFrom=VARAllElementsinActiveView)  # Find Intersections In Lists
scopeIf = Custom[CW.ScopeIf+](VARtest=VARUnjoinVisibleElementsinActiveViewOnly, VARtrue=python_filter_list_from_another, VARfalse=flatten)  # A (hopefully) more robust implementation of ScopeIf. Tests a single boolean and returns a value accordingly.
code_block = CodeBlock { false; }
clean = List.Clean(list=scopeIf, preserveIndices=code_block)
VARListtoUnjoinFrom = Input(VARListtoUnjoinFrom: var[]..[])
flatten_2 = List.Flatten(list=VARListtoUnjoinFrom)
python_filter_list_from_another_2 = Custom[Python Filter List From Another List](VARItemsToFilter=flatten_2, VARAllItemsToFilterFrom=VARAllElementsinActiveView)
scopeIf_2 = Custom[CW.ScopeIf+](VARtest=VARUnjoinVisibleElementsinActiveViewOnly, VARtrue=python_filter_list_from_another_2, VARfalse=flatten_2)
code_block_2 = CodeBlock { false; }
clean_2 = List.Clean(list=scopeIf_2, preserveIndices=code_block_2)
unjoin = Custom[SP.Element.Unjoin](VARfirstElement=clean, VARsecondElement=clean_2)  # Unjoins the element(s) in the second list from the primary input element.
VARUjoinCount = Output(unjoin)
