# Dynamo custom node Update Revit Wait.dyf (Dynamo 2.1.0.7500)
# category: Synthesize.Software
# Update Revit Wait

VARWait = Input(VARWait: var[]..[])
VARVersion = Input(VARVersion: int = 2022)
VARShowMsg = Input(VARShowMsg: bool = true)
python_script = Python(IN[0]=VARWait, IN[1]=VARVersion, IN[2]=VARShowMsg)
# ---------- python_script.python (42 lines) ----------
import clr
clr.AddReference('RevitNodes')
import Revit
clr.AddReference('RevitAPI')
from Autodesk.Revit.DB import *
clr.AddReference('RevitServices')
from RevitServices.Persistence import DocumentManager
from RevitServices.Transactions import TransactionManager
clr.AddReference("RevitAPIUI")
from Autodesk.Revit.UI import TaskDialog

class WarnSwallowSimple(IFailuresPreprocessor):
	def PreprocessFailures(self, failuresAccessor):
		failuresAccessor.DeleteAllWarnings()
		return FailureProcessingResult.Continue

def tolist(obj1):
	if hasattr(obj1,'__iter__'): return obj1
	else: return [obj1]

def flatten(x):
    result = []
    for el in x:
        if hasattr(el, "__iter__") and not isinstance(el, basestring):
            result.extend(flatten(el))
        else:
            result.append(el)
    return result

input = IN[0]
version = IN[1]
showmsg = IN[2]

if int(DocumentManager.Instance.CurrentUIApplication.Application.VersionNumber) < version:
	msg = "Works with Revit " + str(version) + " or above."
	title = "AECedx - Karam"
	if showmsg:
		OUT = TaskDialog.Show(title, msg)
	else:
		OUT = "Stopping"
else:
	OUT = input
# ----------------------------------------
VAROUT = Output(python_script)
