# Dynamo custom node View Range Visual Analyse.dyf (Dynamo 2.1.0.7500)
# category: Synthesize.Automate.Views
# View Range Visual Analyse

VARFalseFloorPlansTrueCeilingPlans = Input(VARFalseFloorPlansTrueCeilingPlans: var[]..[])
VAR1ExactName2ContainsName3All = Input(VAR1ExactName2ContainsName3All: var[]..[])
code_block = CodeBlock { 1; 2; 3; }
eq = VAR1ExactName2ContainsName3All == code_block.out0
mod_get_views_by_type = Custom[MOD.Get Views By Type]()  # Get all views in the project classified by type
scopeIf = Custom[CW.ScopeIf+](VARtest=VARFalseFloorPlansTrueCeilingPlans, VARtrue=mod_get_views_by_type.VARceilingPlans, VARfalse=mod_get_views_by_type.VARfloorPlans)  # A (hopefully) more robust implementation of ScopeIf. Tests a single boolean and returns a value accordingly.

# group: Get All Views of Types ViewPlan
watch = Watch(scopeIf)

code_block_2 = CodeBlock { "View Name"; }
getParameterValueByName = Element.GetParameterValueByName(element=scopeIf, parameterName=code_block_2)
as_list_sortbykey = Custom[AS.[&] List.SortByKey](VARlist=watch, VARkeys=getParameterValueByName)  # Sort a list (or lists) according to the order specified by the key list.

# group: Capture View Names
name = Element.Name(element=as_list_sortbykey.VARsortedlist)
watch_2 = Watch(name)

VARName = Input(VARName: var[]..[])
eq_2 = watch_2 == VARName

# group: Filter View List By Exact Name
filterByBoolMask = List.FilterByBoolMask(list=as_list_sortbykey.VARsortedlist, mask=eq_2)

empty = List.Empty()
scopeIf_2 = Custom[CW.ScopeIf+](VARtest=eq, VARtrue=filterByBoolMask.in, VARfalse=empty)
eq_3 = VAR1ExactName2ContainsName3All == code_block.out1
boolean = BoolSelector(true)

# group: Connect Node to Filter by String.Contains Logic
contains = String.Contains(str=watch_2, searchFor=VARName, ignoreCase=boolean)
watch_3 = Watch(contains)

# group: Filter View List by Containment Name
filterByBoolMask_2 = List.FilterByBoolMask(list=as_list_sortbykey.VARsortedlist, mask=watch_3)

scopeIf_3 = Custom[CW.ScopeIf+](VARtest=eq_3, VARtrue=filterByBoolMask_2.in, VARfalse=empty)
eq_4 = VAR1ExactName2ContainsName3All == code_block.out2
scopeIf_4 = Custom[CW.ScopeIf+](VARtest=eq_4, VARtrue=as_list_sortbykey.VARsortedlist, VARfalse=empty)
create = List.Create(item0=scopeIf_2, item1=scopeIf_3, item2=scopeIf_4)
code_block_3 = CodeBlock { false; }
clean = List.Clean(list=create, preserveIndices=code_block_3)
flatten = List.Flatten(list=clean)

# group: Extract Element IDs
id = Element.Id(element=flatten)

# group: Capture View Range Settings by View
python_get_view_range_settings = Python(IN[0]=flatten)
# ---------- python_get_view_range_settings.python (44 lines) ----------
import clr
clr.AddReference('RevitAPI')
from Autodesk.Revit.DB import *

clr.AddReference("RevitNodes")
import Revit
clr.ImportExtensions(Revit.Elements)

clr.AddReference("RevitServices")
import RevitServices
from RevitServices.Persistence import DocumentManager
from RevitServices.Transactions import TransactionManager

doc = DocumentManager.Instance.CurrentDBDocument
viewList = UnwrapElement(IN[0])

topC_lvl=[]
topC_Off=[]
cutP_lvl=[]
cutP_Off=[]
botP_lvl=[]
botP_Off=[]
dpthP_lvl=[]
dpthP_Off=[]
undrP_lvl=[]
undrP_Off=[]

for v in viewList:
	topC_lvl.append(doc.GetElement(v.GetViewRange().GetLevelId(PlanViewPlane.TopClipPlane)))
	topC_Off.append(v.GetViewRange().GetOffset(PlanViewPlane.TopClipPlane))
	cutP_lvl.append(doc.GetElement(v.GetViewRange().GetLevelId(PlanViewPlane.CutPlane)))
	cutP_Off.append(v.GetViewRange().GetOffset(PlanViewPlane.CutPlane))
	botP_lvl.append(doc.GetElement(v.GetViewRange().GetLevelId(PlanViewPlane.BottomClipPlane)))
	botP_Off.append(v.GetViewRange().GetOffset(PlanViewPlane.BottomClipPlane))
	dpthP_lvl.append(doc.GetElement(v.GetViewRange().GetLevelId(PlanViewPlane.ViewDepthPlane)))
	dpthP_Off.append(v.GetViewRange().GetOffset(PlanViewPlane.ViewDepthPlane))

TransactionManager.Instance.EnsureInTransaction(doc)


	
TransactionManager.Instance.TransactionTaskDone()

OUT = [topC_lvl, topC_Off, cutP_lvl, cutP_Off, botP_lvl, botP_Off, dpthP_lvl, dpthP_Off]
# ----------------------------------------

watch_4 = Watch(python_get_view_range_settings)
code_block_4 = CodeBlock { 1; 3; 5; 7; }
getItemAtIndex = List.GetItemAtIndex(list=watch_4, index=code_block_4.out0)
unit_types = UnitTypes("Length")  # graph input
displayUnitType = Custom[CW.UnitType.DisplayUnitType](VARunitType=unit_types)  # Retrieves the display unit type for a given unit type.
toDisplayUnit = Custom[CW.InternalUnit.ToDisplayUnit](VARval=getItemAtIndex, VARdisplayUnitType=displayUnitType.VARdisplayUnitType)  # Converts a value from Revit's internal unit to a given display unit
replaceItemAtIndex = List.ReplaceItemAtIndex(list=watch_4, index=code_block_4.out0, item=toDisplayUnit)
getItemAtIndex_2 = List.GetItemAtIndex(list=watch_4, index=code_block_4.out1)
toDisplayUnit_2 = Custom[CW.InternalUnit.ToDisplayUnit](VARval=getItemAtIndex_2, VARdisplayUnitType=displayUnitType.VARdisplayUnitType)
replaceItemAtIndex_2 = List.ReplaceItemAtIndex(list=replaceItemAtIndex, index=code_block_4.out1, item=toDisplayUnit_2)
getItemAtIndex_3 = List.GetItemAtIndex(list=watch_4, index=code_block_4.out2)
toDisplayUnit_3 = Custom[CW.InternalUnit.ToDisplayUnit](VARval=getItemAtIndex_3, VARdisplayUnitType=displayUnitType.VARdisplayUnitType)
replaceItemAtIndex_3 = List.ReplaceItemAtIndex(list=replaceItemAtIndex_2, index=code_block_4.out2, item=toDisplayUnit_3)
getItemAtIndex_4 = List.GetItemAtIndex(list=watch_4, index=code_block_4.out3)
toDisplayUnit_4 = Custom[CW.InternalUnit.ToDisplayUnit](VARval=getItemAtIndex_4, VARdisplayUnitType=displayUnitType.VARdisplayUnitType)
replaceItemAtIndex_4 = List.ReplaceItemAtIndex(list=replaceItemAtIndex_3, index=code_block_4.out3, item=toDisplayUnit_4)

# group: Create Combined List with Headers
excel_column_headers = CodeBlock { ["View Element ID","View Name","Top Clip Plane (Level)","Top Clip Plane Offset", "Cut Plane (Level)", "Cut Plane Offset", "Bottom Clip Plane (Level)", "Bottom Clip Plane Offset", "View Depth (Level)", "View Depth Offset"]; }
create_2 = List.Create(item0=excel_column_headers)
create_3 = List.Create(item0=id, item1=flatten)
join = List.Join(list0=create_3, list1=replaceItemAtIndex_4)
transpose = List.Transpose(lists=join)
join_2 = List.Join(list0=create_2, list1=transpose)
watch_5 = Watch(join_2)

transpose_2 = List.Transpose(lists=watch_5)
code_block_5 = CodeBlock { 1; }
dropItems = List.DropItems(list=transpose_2@L2, amount=code_block_5)
cut_plane_levels = CodeBlock(a=dropItems) { a[4]; }
plane = Custom[CW.Level.Plane](VARlevel=cut_plane_levels)  # Retrieves the plane of a given level
VARScopeBox = Input(VARScopeBox: var[]..[])
boundingBox = Element.BoundingBox(element=VARScopeBox)
toCuboid = BoundingBox.ToCuboid(boundingBox=boundingBox)
explode = Geometry.Explode(geometry=toCuboid)
filterByOrientation = Custom[CW.Surface.FilterByOrientation](VARsurfaces=explode)  # Sorts surfaces in three lists based on their orientation (vertical, horizontal up & horizontal down) and also returns three corresponding lists of booleans.
geometry = Element.Geometry(element=VARScopeBox)
intersectAll = Geometry.IntersectAll(geometry=filterByOrientation.VARhorizontalUp, others=geometry, lacing=Longest)
flatten_2 = List.Flatten(list=intersectAll)
code_block_6 = CodeBlock { "Line"; }
byClassName = Custom[SP.Filter.ByClassName](VARobject=flatten_2, VARclassName=code_block_6)  # Filters a list of objects by the object's class name. Note that Dynamo elements belong to different classes than their Revit counterparts. Use the Object.Class node to check an object's class.
as_polycurve_bycurves = Custom[AS.[&] PolyCurve.ByCurves](VARcurves=byClassName.VARin)  # Create polycurves from an unordered list of curves.
intersectAll_2 = Geometry.IntersectAll(geometry=filterByOrientation.VARhorizontalDown, others=geometry, lacing=Longest)
flatten_3 = List.Flatten(list=intersectAll_2)
code_block_7 = CodeBlock { "Line"; }
byClassName_2 = Custom[SP.Filter.ByClassName](VARobject=flatten_3, VARclassName=code_block_7)
as_polycurve_bycurves_2 = Custom[AS.[&] PolyCurve.ByCurves](VARcurves=byClassName_2.VARin)
join_3 = List.Join(list0=as_polycurve_bycurves.VARpolyCurve, list1=as_polycurve_bycurves_2.VARpolyCurve)
byLoft = Solid.ByLoft(crossSections=join_3)
top_offset = CodeBlock(a=dropItems) { a[3]; }
cut_plane_offset = CodeBlock(a=dropItems) { a[5]; }
depth_offset = CodeBlock(a=dropItems) { a[9]; }
code_block_8 = CodeBlock(a=top_offset, b=cut_plane_offset, c=depth_offset) { a+b+c; }
sum = Math.Sum(values=code_block_8)
scale = Geometry.Scale(geometry=byLoft, zamount=sum)
top_levels = CodeBlock(a=dropItems) { a[2]; }
plane_2 = Custom[CW.Level.Plane](VARlevel=top_levels)
VARUnlimitedTopDistance = Input(VARUnlimitedTopDistance: var[]..[])
code_block_9 = CodeBlock(a=VARUnlimitedTopDistance) { a+1; }
convert_between_units = DynamoConvert(code_block_9, MeasurementType="Length", FromConversion="Meters", ToConversion="Feet")
unit_types_2 = UnitTypes("Length")
displayUnitType_2 = Custom[CW.UnitType.DisplayUnitType](VARunitType=unit_types_2)
toDisplayUnit_5 = Custom[CW.InternalUnit.ToDisplayUnit](VARval=convert_between_units, VARdisplayUnitType=displayUnitType_2.VARdisplayUnitType)
number = DoubleInput(50)
number_2 = DoubleInput(50)
number_slider = DoubleSlider(0.1, range=0.1..1 step 0.1)
number_slider_2 = DoubleSlider(2, range=0..5 step 0.1)
number_slider_3 = DoubleSlider(5, range=0..10 step 0.1)
number_3 = DoubleInput(0)
number_4 = DoubleInput(8)
number_5 = DoubleInput(0)
number_6 = DoubleInput(8)
lb_lunchbox_wave = Custom[LB.LunchBox Wave](VARU=number, VARV=number_2, VARA=number_slider, VARB=number_slider_2, VARS=number_slider_3, VARU0=number_3, VARU1=number_4, VARV0=number_5, VARV1=number_6)  # Creates a parametric Wave surface
code_block_10 = CodeBlock { 0.5; }
code_block_11 = CodeBlock { 2; }
byGeometry = BoundingBox.ByGeometry(geom=lb_lunchbox_wave)
dimensions = Custom[ZK.BoundingBox.Dimensions](VARBoundingBox=byGeometry)  # Input Bounding Box element to get its dimensions (Width, Length, Height). Setting Boolean switch to True rounds output values.
code_block_12 = CodeBlock { 1; }
code_block_13 = CodeBlock { 0.5; }
VARCategory = Input(VARCategory: var[]..[])
VARTopMaterial = Input(VARTopMaterial: var[]..[])
byName = Material.ByName(name=VARTopMaterial)
code_block_14 = CodeBlock(a=dropItems) { a[1]; }
code_block_15 = CodeBlock { "View Name"; }
getParameterValueByName_2 = Element.GetParameterValueByName(element=code_block_14, parameterName=code_block_15)
code_block_16 = CodeBlock { "Comments"; }
bottom_offset = CodeBlock(a=dropItems) { a[7]; }
VARUnlimitedBottomDepthDistance = Input(VARUnlimitedBottomDepthDistance: var[]..[])
code_block_17 = CodeBlock(a=VARUnlimitedBottomDepthDistance) { a-1; }
convert_between_units_2 = DynamoConvert(code_block_17, MeasurementType="Length", FromConversion="Meters", ToConversion="Feet")
toDisplayUnit_6 = Custom[CW.InternalUnit.ToDisplayUnit](VARval=convert_between_units_2, VARdisplayUnitType=displayUnitType_2.VARdisplayUnitType)
bottom_levels = CodeBlock(a=dropItems) { a[6]; }
plane_3 = Custom[CW.Level.Plane](VARlevel=bottom_levels)

# group: Cut Plane Zone
intersect_cut_plane_level = Geometry.IntersectAll(geometry=plane, others=scale, lacing=Longest)
translate = Geometry.Translate(geometry=intersect_cut_plane_level, zTranslation=cut_plane_offset)
join_4 = List.Join()  # unwired: list0, list1
add = bottom_offset + toDisplayUnit_6
add_2 = bottom_offset + add
isNull = Object.IsNull(obj=plane_3)
filterByBoolMask_3 = List.FilterByBoolMask(list=add_2, mask=isNull)
mergeByBoolMask = Custom[SP.List.MergeByBoolMask](VARIn=filterByBoolMask_3.in, VAROut=bottom_offset, VARmask=isNull)  # Merge two lists by a boolean mask list. The true count in the mask should be the same as the length of the true list and vice versa for the false list.
translate_2 = Geometry.Translate(geometry=intersect_cut_plane_level, zTranslation=mergeByBoolMask)
perimeterCurves = Surface.PerimeterCurves(surface=translate_2)
as_polycurve_bycurves_3 = Custom[AS.[&] PolyCurve.ByCurves](VARcurves=perimeterCurves)
flatten_4 = List.Flatten(list=as_polycurve_bycurves_3.VARpolyCurve@L2)
perimeterCurves_2 = Surface.PerimeterCurves(surface=translate)
as_polycurve_bycurves_4 = Custom[AS.[&] PolyCurve.ByCurves](VARcurves=perimeterCurves_2)
flatten_5 = List.Flatten(list=as_polycurve_bycurves_4.VARpolyCurve@L2)
combine = List.Combine(comb=join_4, list1=flatten_4, list2=flatten_5)
byLoft_2 = Solid.ByLoft()  # unwired: crossSections
map = List.Map(list=combine, f_x=byLoft_2)

# group: Top Zone
empty_2 = List.Empty()
join_5 = List.Join()  # unwired: list0, list1
translate_3 = Geometry.Translate(geometry=intersect_cut_plane_level, zTranslation=cut_plane_offset)
perimeterCurves_3 = Surface.PerimeterCurves(surface=translate_3)
as_polycurve_bycurves_5 = Custom[AS.[&] PolyCurve.ByCurves](VARcurves=perimeterCurves_3)
flatten_6 = List.Flatten(list=as_polycurve_bycurves_5.VARpolyCurve@L2)
isNull_2 = Object.IsNull(obj=plane_2)
filterByBoolMask_4 = List.FilterByBoolMask(list=translate, mask=isNull_2)
translate_4 = Geometry.Translate(geometry=filterByBoolMask_4.in, zTranslation=toDisplayUnit_5)
filterByBoolMask_5 = List.FilterByBoolMask(list=plane_2, mask=isNull_2)
intersect_top = Geometry.IntersectAll(geometry=filterByBoolMask_5.out, others=scale, lacing=Longest)
filterByBoolMask_6 = List.FilterByBoolMask(list=top_offset, mask=isNull_2)
translate_5 = Geometry.Translate(geometry=intersect_top, zTranslation=filterByBoolMask_6.out)
mergeByBoolMask_2 = Custom[SP.List.MergeByBoolMask](VARIn=translate_4, VAROut=translate_5, VARmask=isNull_2)
perimeterCurves_4 = Surface.PerimeterCurves(surface=mergeByBoolMask_2)
as_polycurve_bycurves_6 = Custom[AS.[&] PolyCurve.ByCurves](VARcurves=perimeterCurves_4)
flatten_7 = List.Flatten(list=as_polycurve_bycurves_6.VARpolyCurve@L2)
combine_2 = List.Combine(comb=join_5, list1=flatten_6, list2=flatten_7)
byLoft_3 = Solid.ByLoft()  # unwired: crossSections
map_2 = List.Map(list=combine_2, f_x=byLoft_3)

# group: Top Range
scopeIf_5 = Custom[CW.ScopeIf+](VARtest=VARFalseFloorPlansTrueCeilingPlans, VARtrue=empty_2, VARfalse=map_2)
is_unlimited = Object.IsNull(obj=plane_2)

filterByBoolMask_7 = List.FilterByBoolMask(list=scopeIf_5, mask=is_unlimited)
explode_2 = Geometry.Explode(geometry=filterByBoolMask_7.in)
filterByOrientation_2 = Custom[CW.Surface.FilterByOrientation](VARsurfaces=explode_2)
perimeterCurves_5 = Surface.PerimeterCurves(surface=filterByOrientation_2.VARhorizontalUp)
pointAtParameter = Curve.PointAtParameter(curve=perimeterCurves_5, param=code_block_10)
dropEveryNthItem = List.DropEveryNthItem(list=pointAtParameter@L2, n=code_block_11)
byBestFitThroughPoints = Line.ByBestFitThroughPoints(bestFitPoints=dropEveryNthItem@L2)
length = Curve.Length(curve=byBestFitThroughPoints)
div = length / dimensions.VARWidth
dropEveryNthItem_2 = List.DropEveryNthItem(list=pointAtParameter@L2, n=code_block_11, offset=code_block_12)
byBestFitThroughPoints_2 = Line.ByBestFitThroughPoints(bestFitPoints=dropEveryNthItem_2@L2)
length_2 = Curve.Length(curve=byBestFitThroughPoints_2)
div_2 = length_2 / dimensions.VARLength
byGeometry_2 = BoundingBox.ByGeometry(geom=filterByBoolMask_7.in@L1)
dimensions_2 = Custom[ZK.BoundingBox.Dimensions](VARBoundingBox=byGeometry_2)
div_3 = dimensions_2.VARHeight / dimensions.VARHeight
code_block_18 = CodeBlock(a=div_3) { a*0.75; }
scale_2 = Geometry.Scale(geometry=lb_lunchbox_wave, xamount=div, yamount=div_2, zamount=code_block_18)
byGeometry_3 = BoundingBox.ByGeometry(geom=scale_2)
centerPoint = Custom[ZK.BoundingBox.CenterPoint](VARBoundingBox=byGeometry_3)  # Input Bounding Box element to get its center point. This node is little and lightweight, as it doesn't convert bounding box to geometry to get its centroid point.
XYZ = Custom[LF.Point.XYZ](VARpoint=centerPoint)  # Get the X, Y, and Z components of a Point
maxPoint = BoundingBox.MaxPoint(boundingBox=byGeometry_3)
XYZ_2 = Custom[LF.Point.XYZ](VARpoint=maxPoint)
byOrigin = CoordinateSystem.ByOrigin(x=XYZ.VARX, y=XYZ.VARY, z=XYZ_2.VARZ)
pointAtParameter_2 = Surface.PointAtParameter(surface=filterByOrientation_2.VARhorizontalUp, u=code_block_13, v=code_block_13)
firstItem = List.FirstItem(list=dropEveryNthItem@L2)
lastItem = List.LastItem(list=dropEveryNthItem@L2)
byTwoPoints = Vector.ByTwoPoints(start=firstItem, end=lastItem)
byOriginNormalXAxis = Plane.ByOriginNormalXAxis(origin=pointAtParameter_2, xAxis=byTwoPoints)
byPlane = CoordinateSystem.ByPlane(plane=byOriginNormalXAxis)
transform = Geometry.Transform(geometry=scale_2, fromCoordinateSystem=byOrigin, contextCoordinateSystem=byPlane)
split = Geometry.Split(geometry=filterByBoolMask_7.in, other=transform)
firstItem_2 = List.FirstItem(list=split@@L2)
mergeByBoolMask_3 = Custom[SP.List.MergeByBoolMask](VARIn=firstItem_2, VAROut=filterByBoolMask_7.out, VARmask=is_unlimited)

# group: Top Range
code_block_19 = CodeBlock { 1; }
normalizeDepth = List.NormalizeDepth(list=mergeByBoolMask_3, rank=code_block_19)

isNull_3 = Object.IsNull(obj=normalizeDepth)
filterByBoolMask_8 = List.FilterByBoolMask(list=normalizeDepth, mask=isNull_3)
filterByBoolMask_9 = List.FilterByBoolMask(list=getParameterValueByName_2, mask=isNull_3)
byGeometry_4 = DirectShape.ByGeometry(geometry=filterByBoolMask_8.out, category=VARCategory, material=byName, name=filterByBoolMask_9.out)
setParameterByName = Element.SetParameterByName(element=byGeometry_4, parameterName=code_block_16, value=filterByBoolMask_9.out)

# group: Cutplane Range
scopeIf_6 = Custom[CW.ScopeIf+](VARtest=VARFalseFloorPlansTrueCeilingPlans, VARtrue=map_2, VARfalse=map)
is_unlimited_2 = Object.IsNull(obj=plane_3)

scopeIf_7 = Custom[CW.ScopeIf+](VARtest=VARFalseFloorPlansTrueCeilingPlans, VARtrue=is_unlimited, VARfalse=is_unlimited_2)
filterByBoolMask_10 = List.FilterByBoolMask(list=scopeIf_6, mask=scopeIf_7)
explode_3 = Geometry.Explode(geometry=filterByBoolMask_10.in)
filterByOrientation_3 = Custom[CW.Surface.FilterByOrientation](VARsurfaces=explode_3)
scopeIf_8 = Custom[CW.ScopeIf+](VARtest=VARFalseFloorPlansTrueCeilingPlans, VARtrue=filterByOrientation_3.VARhorizontalUp, VARfalse=filterByOrientation_3.VARhorizontalDown)
perimeterCurves_6 = Surface.PerimeterCurves(surface=scopeIf_8)
code_block_20 = CodeBlock { 0.5; }
pointAtParameter_3 = Curve.PointAtParameter(curve=perimeterCurves_6, param=code_block_20)
code_block_21 = CodeBlock { 2; }
dropEveryNthItem_3 = List.DropEveryNthItem(list=pointAtParameter_3@L2, n=code_block_21)
byBestFitThroughPoints_3 = Line.ByBestFitThroughPoints(bestFitPoints=dropEveryNthItem_3@L2)
length_3 = Curve.Length(curve=byBestFitThroughPoints_3)
div_4 = length_3 / dimensions.VARWidth
code_block_22 = CodeBlock { 1; }
dropEveryNthItem_4 = List.DropEveryNthItem(list=pointAtParameter_3@L2, n=code_block_21, offset=code_block_22)
byBestFitThroughPoints_4 = Line.ByBestFitThroughPoints(bestFitPoints=dropEveryNthItem_4@L2)
length_4 = Curve.Length(curve=byBestFitThroughPoints_4)
div_5 = length_4 / dimensions.VARLength
byGeometry_5 = BoundingBox.ByGeometry(geom=filterByBoolMask_10.in@L1)
dimensions_3 = Custom[ZK.BoundingBox.Dimensions](VARBoundingBox=byGeometry_5)
div_6 = dimensions_3.VARHeight / dimensions.VARHeight
code_block_23 = CodeBlock(a=div_6) { a*0.75; }
scale_3 = Geometry.Scale(geometry=lb_lunchbox_wave, xamount=div_4, yamount=div_5, zamount=code_block_23)
byGeometry_6 = BoundingBox.ByGeometry(geom=scale_3)
centerPoint_2 = Custom[ZK.BoundingBox.CenterPoint](VARBoundingBox=byGeometry_6)
XYZ_3 = Custom[LF.Point.XYZ](VARpoint=centerPoint_2)
maxPoint_2 = BoundingBox.MaxPoint(boundingBox=byGeometry_6)
minPoint = BoundingBox.MinPoint(boundingBox=byGeometry_6)
scopeIf_9 = Custom[CW.ScopeIf+](VARtest=VARFalseFloorPlansTrueCeilingPlans, VARtrue=maxPoint_2, VARfalse=minPoint)
XYZ_4 = Custom[LF.Point.XYZ](VARpoint=scopeIf_9)
byOrigin_2 = CoordinateSystem.ByOrigin(x=XYZ_3.VARX, y=XYZ_3.VARY, z=XYZ_4.VARZ)
code_block_24 = CodeBlock { 0.5; }
pointAtParameter_4 = Surface.PointAtParameter(surface=scopeIf_8, u=code_block_24, v=code_block_24)
firstItem_3 = List.FirstItem(list=dropEveryNthItem_3@L2)
lastItem_2 = List.LastItem(list=dropEveryNthItem_3@L2)
byTwoPoints_2 = Vector.ByTwoPoints(start=firstItem_3, end=lastItem_2)
byOriginNormalXAxis_2 = Plane.ByOriginNormalXAxis(origin=pointAtParameter_4, xAxis=byTwoPoints_2)
byPlane_2 = CoordinateSystem.ByPlane(plane=byOriginNormalXAxis_2)
transform_2 = Geometry.Transform(geometry=scale_3, fromCoordinateSystem=byOrigin_2, contextCoordinateSystem=byPlane_2)
split_2 = Geometry.Split(geometry=filterByBoolMask_10.in, other=transform_2)
firstItem_4 = List.FirstItem(list=split_2@@L2)
lastItem_3 = List.LastItem(list=split_2@@L2)
scopeIf_10 = Custom[CW.ScopeIf+](VARtest=VARFalseFloorPlansTrueCeilingPlans, VARtrue=firstItem_4, VARfalse=lastItem_3)
mergeByBoolMask_4 = Custom[SP.List.MergeByBoolMask](VARIn=scopeIf_10, VAROut=filterByBoolMask_10.out, VARmask=scopeIf_7)

# group: Cut Plane Range
code_block_25 = CodeBlock { 1; }
normalizeDepth_2 = List.NormalizeDepth(list=mergeByBoolMask_4, rank=code_block_25)

isNull_4 = Object.IsNull(obj=normalizeDepth_2)
filterByBoolMask_11 = List.FilterByBoolMask(list=normalizeDepth_2, mask=isNull_4)
VARCutMaterial = Input(VARCutMaterial: var[]..[])
byName_2 = Material.ByName(name=VARCutMaterial)
filterByBoolMask_12 = List.FilterByBoolMask(list=getParameterValueByName_2, mask=isNull_4)
byGeometry_7 = DirectShape.ByGeometry(geometry=filterByBoolMask_11.out, category=VARCategory, material=byName_2, name=filterByBoolMask_12.out)
code_block_26 = CodeBlock { "Comments"; }
setParameterByName_2 = Element.SetParameterByName(element=byGeometry_7, parameterName=code_block_26, value=filterByBoolMask_12.out)
is_unlimited_3 = Object.IsNull(obj=plane_2)
code_block_27 = CodeBlock { false; }
scopeIf_11 = Custom[CW.ScopeIf+](VARtest=VARFalseFloorPlansTrueCeilingPlans, VARtrue=is_unlimited_3, VARfalse=code_block_27)
empty_3 = List.Empty()
depth_level = CodeBlock(a=dropItems) { a[8]; }
plane_4 = Custom[CW.Level.Plane](VARlevel=depth_level)

# group: Depth Ceiling Zone
join_6 = List.Join()  # unwired: list0, list1
perimeterCurves_7 = Surface.PerimeterCurves(surface=mergeByBoolMask_2)
as_polycurve_bycurves_7 = Custom[AS.[&] PolyCurve.ByCurves](VARcurves=perimeterCurves_7)
flatten_8 = List.Flatten(list=as_polycurve_bycurves_7.VARpolyCurve@L2)
isNull_5 = Object.IsNull(obj=plane_4)
filterByBoolMask_13 = List.FilterByBoolMask(list=mergeByBoolMask_2, mask=isNull_5)
translate_6 = Geometry.Translate(geometry=filterByBoolMask_13.in, zTranslation=toDisplayUnit_5)
filterByBoolMask_14 = List.FilterByBoolMask(list=plane_4, mask=isNull_5)
intersect_depth_plane_level = Geometry.IntersectAll(geometry=filterByBoolMask_14.out, others=scale, lacing=Longest)
filterByBoolMask_15 = List.FilterByBoolMask(list=depth_offset, mask=isNull_5)
translate_7 = Geometry.Translate(geometry=intersect_depth_plane_level, zTranslation=filterByBoolMask_15.out)
mergeByBoolMask_5 = Custom[SP.List.MergeByBoolMask](VARIn=translate_6, VAROut=translate_7, VARmask=isNull_5)
perimeterCurves_8 = Surface.PerimeterCurves(surface=mergeByBoolMask_5)
as_polycurve_bycurves_8 = Custom[AS.[&] PolyCurve.ByCurves](VARcurves=perimeterCurves_8)
flatten_9 = List.Flatten(list=as_polycurve_bycurves_8.VARpolyCurve@L2)
combine_3 = List.Combine(comb=join_6, list1=flatten_8, list2=flatten_9)
byLoft_4 = Solid.ByLoft()  # unwired: crossSections
map_3 = List.Map(list=combine_3, f_x=byLoft_4)

# group: Depth Zone
code_block_28 = CodeBlock { null; }
turnIntoList = Custom[CW.TurnIntoList](VARunknownItem=code_block_28)  # Turns an element (or a nested list) into a flat list
isNull_6 = Object.IsNull(obj=plane_3)
count = List.Count(list=isNull_6)
cycle = List.Cycle(list=turnIntoList, amount=count)
python_empty_2_null = Custom[Python Empty 2 Null](VARIN=cycle)  # Python Null 2 Empty
filterByBoolMask_16 = List.FilterByBoolMask(list=python_empty_2_null, mask=isNull_6)
join_7 = List.Join()  # unwired: list0, list1
filterByBoolMask_17 = List.FilterByBoolMask(list=plane_3, mask=isNull_6)
intersect_bottom = Geometry.IntersectAll(geometry=filterByBoolMask_17.out, others=scale, lacing=Longest)
filterByBoolMask_18 = List.FilterByBoolMask(list=bottom_offset, mask=isNull_6)
translate_8 = Geometry.Translate(geometry=intersect_bottom, zTranslation=filterByBoolMask_18.out)
perimeterCurves_9 = Surface.PerimeterCurves(surface=translate_8)
as_polycurve_bycurves_9 = Custom[AS.[&] PolyCurve.ByCurves](VARcurves=perimeterCurves_9)
flatten_10 = List.Flatten(list=as_polycurve_bycurves_9.VARpolyCurve@L2)
filterByBoolMask_19 = List.FilterByBoolMask(list=plane_4, mask=isNull_6)
isNull_7 = Object.IsNull(obj=filterByBoolMask_19.out)
filterByBoolMask_20 = List.FilterByBoolMask(list=intersect_bottom, mask=isNull_7)
translate_9 = Geometry.Translate(geometry=filterByBoolMask_20.in, zTranslation=toDisplayUnit_6)
filterByBoolMask_21 = List.FilterByBoolMask(list=plane_4, mask=isNull_6)
filterByBoolMask_22 = List.FilterByBoolMask(list=filterByBoolMask_21.out, mask=isNull_7)
intersect_depth = Geometry.IntersectAll(geometry=filterByBoolMask_22.out, others=scale, lacing=Longest)
filterByBoolMask_23 = List.FilterByBoolMask(list=depth_offset, mask=isNull_6)
filterByBoolMask_24 = List.FilterByBoolMask(list=filterByBoolMask_23.out, mask=isNull_7)
translate_10 = Geometry.Translate(geometry=intersect_depth, zTranslation=filterByBoolMask_24.out)
mergeByBoolMask_6 = Custom[SP.List.MergeByBoolMask](VARIn=translate_9, VAROut=translate_10, VARmask=isNull_7)
perimeterCurves_10 = Surface.PerimeterCurves(surface=mergeByBoolMask_6)
as_polycurve_bycurves_10 = Custom[AS.[&] PolyCurve.ByCurves](VARcurves=perimeterCurves_10)
flatten_11 = List.Flatten(list=as_polycurve_bycurves_10.VARpolyCurve@L2)
combine_4 = List.Combine(comb=join_7, list1=flatten_10, list2=flatten_11)
byLoft_5 = Solid.ByLoft()  # unwired: crossSections
map_4 = List.Map(list=combine_4, f_x=byLoft_5)
mergeByBoolMask_7 = Custom[SP.List.MergeByBoolMask](VARIn=filterByBoolMask_16.in, VAROut=map_4, VARmask=isNull_6)

# group: Depth Zone
scopeIf_12 = Custom[CW.ScopeIf+](VARtest=VARFalseFloorPlansTrueCeilingPlans, VARtrue=map_3, VARfalse=mergeByBoolMask_7)
is_unlimited_4 = Object.IsNull(obj=plane_4)

scopeIf_13 = Custom[CW.ScopeIf+](VARtest=scopeIf_11, VARtrue=empty_3, VARfalse=scopeIf_12)
filterByBoolMask_25 = List.FilterByBoolMask(list=scopeIf_13, mask=is_unlimited_4)
explode_4 = Geometry.Explode(geometry=filterByBoolMask_25.in)
filterByOrientation_4 = Custom[CW.Surface.FilterByOrientation](VARsurfaces=explode_4)
scopeIf_14 = Custom[CW.ScopeIf+](VARtest=VARFalseFloorPlansTrueCeilingPlans, VARtrue=filterByOrientation_4.VARhorizontalUp, VARfalse=filterByOrientation_4.VARhorizontalDown)
perimeterCurves_11 = Surface.PerimeterCurves(surface=scopeIf_14)
code_block_29 = CodeBlock { 0.5; }
pointAtParameter_5 = Curve.PointAtParameter(curve=perimeterCurves_11, param=code_block_29)
code_block_30 = CodeBlock { 2; }
dropEveryNthItem_5 = List.DropEveryNthItem(list=pointAtParameter_5@L2, n=code_block_30)
byBestFitThroughPoints_5 = Line.ByBestFitThroughPoints(bestFitPoints=dropEveryNthItem_5@L2)
length_5 = Curve.Length(curve=byBestFitThroughPoints_5)
div_7 = length_5 / dimensions.VARWidth
code_block_31 = CodeBlock { 1; }
dropEveryNthItem_6 = List.DropEveryNthItem(list=pointAtParameter_5@L2, n=code_block_30, offset=code_block_31)
byBestFitThroughPoints_6 = Line.ByBestFitThroughPoints(bestFitPoints=dropEveryNthItem_6@L2)
length_6 = Curve.Length(curve=byBestFitThroughPoints_6)
div_8 = length_6 / dimensions.VARLength
byGeometry_8 = BoundingBox.ByGeometry(geom=filterByBoolMask_25.in@L1)
dimensions_4 = Custom[ZK.BoundingBox.Dimensions](VARBoundingBox=byGeometry_8)
div_9 = dimensions_4.VARHeight / dimensions.VARHeight
code_block_32 = CodeBlock(a=div_9) { a*0.75; }
scale_4 = Geometry.Scale(geometry=lb_lunchbox_wave, xamount=div_7, yamount=div_8, zamount=code_block_32)
byGeometry_9 = BoundingBox.ByGeometry(geom=scale_4)
centerPoint_3 = Custom[ZK.BoundingBox.CenterPoint](VARBoundingBox=byGeometry_9)
XYZ_5 = Custom[LF.Point.XYZ](VARpoint=centerPoint_3)
maxPoint_3 = BoundingBox.MaxPoint(boundingBox=byGeometry_9)
minPoint_2 = BoundingBox.MinPoint(boundingBox=byGeometry_9)
scopeIf_15 = Custom[CW.ScopeIf+](VARtest=VARFalseFloorPlansTrueCeilingPlans, VARtrue=maxPoint_3, VARfalse=minPoint_2)
XYZ_6 = Custom[LF.Point.XYZ](VARpoint=scopeIf_15)
byOrigin_3 = CoordinateSystem.ByOrigin(x=XYZ_5.VARX, y=XYZ_5.VARY, z=XYZ_6.VARZ)
code_block_33 = CodeBlock { 0.5; }
pointAtParameter_6 = Surface.PointAtParameter(surface=scopeIf_14, u=code_block_33, v=code_block_33)
firstItem_5 = List.FirstItem(list=dropEveryNthItem_5@L2)
lastItem_4 = List.LastItem(list=dropEveryNthItem_5@L2)
byTwoPoints_3 = Vector.ByTwoPoints(start=firstItem_5, end=lastItem_4)
byOriginNormalXAxis_3 = Plane.ByOriginNormalXAxis(origin=pointAtParameter_6, xAxis=byTwoPoints_3)
byPlane_3 = CoordinateSystem.ByPlane(plane=byOriginNormalXAxis_3)
transform_3 = Geometry.Transform(geometry=scale_4, fromCoordinateSystem=byOrigin_3, contextCoordinateSystem=byPlane_3)
split_3 = Geometry.Split(geometry=filterByBoolMask_25.in, other=transform_3)
firstItem_6 = List.FirstItem(list=split_3@L2)
lastItem_5 = List.LastItem(list=split_3@@L2)
scopeIf_16 = Custom[CW.ScopeIf+](VARtest=VARFalseFloorPlansTrueCeilingPlans, VARtrue=firstItem_6, VARfalse=lastItem_5)
mergeByBoolMask_8 = Custom[SP.List.MergeByBoolMask](VARIn=scopeIf_16, VAROut=filterByBoolMask_25.out, VARmask=is_unlimited_4)

# group: Depth Range
code_block_34 = CodeBlock { 1; }
normalizeDepth_3 = List.NormalizeDepth(list=mergeByBoolMask_8, rank=code_block_34)

isNull_8 = Object.IsNull(obj=normalizeDepth_3)
filterByBoolMask_26 = List.FilterByBoolMask(list=normalizeDepth_3, mask=isNull_8)
VARDepthMaterial = Input(VARDepthMaterial: var[]..[])
byName_3 = Material.ByName(name=VARDepthMaterial)
filterByBoolMask_27 = List.FilterByBoolMask(list=getParameterValueByName_2, mask=isNull_8)
byGeometry_10 = DirectShape.ByGeometry(geometry=filterByBoolMask_26.out, category=VARCategory, material=byName_3, name=filterByBoolMask_27.out)
code_block_35 = CodeBlock { "Comments"; }
setParameterByName_3 = Element.SetParameterByName(element=byGeometry_10, parameterName=code_block_35, value=filterByBoolMask_27.out)
create_4 = List.Create(item0=setParameterByName, item1=setParameterByName_2, item2=setParameterByName_3)
code_block_36 = CodeBlock { false; }
clean_2 = List.Clean(list=create_4, preserveIndices=code_block_36)
flatten_12 = List.Flatten(list=clean_2)
VARDirectShape = Output(flatten_12)
