# Dynamo custom node Walls By Profiles.dyf (Dynamo 2.1.0.7500)
# category: Synthesize.Automate.Wall
# Walls By Curves

VARCurves = Input(VARCurves: var[]..[])
VARWallType = Input(VARWallType: var[]..[])
VARLevels = Input(VARLevels: var[]..[])
VARLocationLine = Input(VARLocationLine: var[]..[])
VARVector = Input(VARVector: var[]..[])
VARHeights = Input(VARHeights: var[]..[])
python_script = Python(IN[0]=VARCurves, IN[1]=VARWallType, IN[2]=VARLevels, IN[3]=VARLocationLine, IN[4]=VARVector, IN[5]=VARHeights)
# ---------- python_script.python (201 lines) ----------
# Enable Python support and load DesignScript library
# IMPORTANT : ALL DYNAMO DESIGN SCRIPT NODES ARE AS (dg)
import clr
clr.AddReference('ProtoGeometry')
from Autodesk.DesignScript import Geometry as dg

import sys
sys.path.append(r'C:\Program Files (x86)\IronPython 2.7\DLLs')
sys.path.append(r'C:\Program Files (x86)\IronPython 2.7\Lib')
import random

# EXTENSION Enable ToDSType
clr.AddReference('RevitNodes')
import Revit
clr.ImportExtensions(Revit.Elements)

# Enable Revit Elements
from Revit.Elements import *

# EXTENSION Enable Geometry Conversion Methods
clr.ImportExtensions(Revit.GeometryConversion)

# Enable Revit API
clr.AddReference('RevitAPI')
from Autodesk.Revit.DB import *

# Enable DocumentManager and TransactionManager
clr.AddReference('RevitServices')
from RevitServices.Persistence import DocumentManager
from RevitServices.Transactions import TransactionManager

# Enable ICollection List Translate
clr.AddReference("System")
import System.Collections.Generic
from System.Collections.Generic import List

class WarnSwallow(IFailuresPreprocessor):
	def PreprocessFailures(self, failuresAccessor):
		failuresAccessor.DeleteAllWarnings()
		return FailureProcessingResult.Continue

dataEnteringNode = IN
# Use UnwrapElement(IN[0]) When Translating From Dynamo to Revit
curves = UnwrapElement(IN[0])
walltypeid = UnwrapElement(IN[1]).Id
levels = UnwrapElement(IN[2])
locline = IN[3]
vectors = UnwrapElement(IN[4])
bheights = UnwrapElement(IN[5])
proceed = True

levelids = []
for e in levels:
	levelids.append(e.Id)
# Choose The Current Document
doc = DocumentManager.Instance.CurrentDBDocument
uidoc = DocumentManager.Instance.CurrentUIApplication.ActiveUIDocument
uiapp = DocumentManager.Instance.CurrentUIApplication
app = uiapp.Application

# Create Empty List
result = []

if int(DocumentManager.Instance.CurrentUIApplication.Application.VersionNumber) < 2021:
	units = doc.GetUnits().GetFormatOptions(UnitType.UT_Length).DisplayUnits
	factor = UnitUtils.ConvertToInternalUnits(1,units)
else:
	factor = UnitUtils.ConvertToInternalUnits(1,doc.GetUnits().GetFormatOptions(SpecTypeId.Length).GetUnitTypeId())
	
if proceed == True:
	###STEP 1 NEW TYPE###
	TransactionManager.Instance.ForceCloseTransaction()
	tGroup = TransactionGroup(doc, 'Wall By Edge')
	tGroup.Start()
	trans1 = Transaction(doc, 'Creating Temporary Wall Type')
	trans1.Start()
	foptions = trans1.GetFailureHandlingOptions()
	foptions.SetFailuresPreprocessor(WarnSwallow())
	trans1.SetFailureHandlingOptions(foptions)
	existedwalltype = doc.GetElement(walltypeid)
	duplicated = doc.GetElement(walltypeid).Duplicate("TMP " + str(existedwalltype.Id) + " " + str(random.randint(1,99999)))
	thecompound = CompoundStructure.CreateSingleLayerCompoundStructure(MaterialFunctionAssignment.Structure,existedwalltype.Width/2,FilteredElementCollector(doc).OfClass(Material).FirstElementId())
	duplicated.SetCompoundStructure(thecompound)
	trans1.Commit()

	###STEP 2 CREATE WALLS###
	#Revit.Transaction.Transaction.End(doc)
	trans2 = Transaction(doc, 'Creating Walls')
	trans2.Start()
	foptions = trans2.GetFailureHandlingOptions()
	foptions.SetFailuresPreprocessor(WarnSwallow())
	trans2.SetFailureHandlingOptions(foptions)
	counter = 0
	for c in curves:
		try:
			prf = List[Curve]()
			for minc in c:
				prf.Add(minc.ToRevitType())
			wallcreate = Wall.Create(doc,prf,existedwalltype.Id,levelids[counter],False,vectors[counter].ToXyz())
			bparam = wallcreate.get_Parameter(BuiltInParameter.WALL_BASE_OFFSET)
			bparam.Set(bheights[counter])
			if locline == 1:
				lset = 3
			elif locline == 2:
				lset = 2
			elif locline == 3:
				lset = 0
			param = wallcreate.get_Parameter(BuiltInParameter.WALL_KEY_REF_PARAM).Set(lset)
			result.append(wallcreate)
		except: pass
		counter += 1
	trans2.Commit()
	#Revit.Transaction.Transaction.End(doc)
	
	if len(result) > 0:
		###STEP 3 SET NEW TYPE###
		trans3 = Transaction(doc, 'Set to Temporary Wall Type')
		trans3.Start()
		foptions = trans3.GetFailureHandlingOptions()
		foptions.SetFailuresPreprocessor(WarnSwallow())
		trans3.SetFailureHandlingOptions(foptions)
		for e in result:
			WallUtils.DisallowWallJoinAtEnd(e,0)
			WallUtils.DisallowWallJoinAtEnd(e,1)
			e.ChangeTypeId(duplicated.Id)
		trans3.Commit()
		
		#Revit.Transaction.Transaction.End(doc)
		###STEP 4 SET EXTERIOR LOCATION LINE###
		trans4 = Transaction(doc, 'Set Interior Location Line For Walls')
		trans4.Start()
		foptions = trans4.GetFailureHandlingOptions()
		foptions.SetFailuresPreprocessor(WarnSwallow())
		trans4.SetFailureHandlingOptions(foptions)
		for e in result:
			if locline == 1:
				lset = 2
			elif locline == 2:
				lset = 3
			elif locline == 3:
				lset = 0
			e.get_Parameter(BuiltInParameter.WALL_KEY_REF_PARAM).Set(lset)
		trans4.Commit()
		
		#Revit.Transaction.Transaction.End(doc)
		###STEP 5 RESTORE EXISTED TYPE###
		trans5 = Transaction(doc, 'Restore Correct Wall Type')
		trans5.Start()
		foptions = trans5.GetFailureHandlingOptions()
		foptions.SetFailuresPreprocessor(WarnSwallow())
		trans5.SetFailureHandlingOptions(foptions)
		for e in result:
			e.ChangeTypeId(existedwalltype.Id)
		trans5.Commit()
		
		#Revit.Transaction.Transaction.End(doc)
		###STEP 6 SET WALL CENTERLINE LOCATION LINE###
		trans6 = Transaction(doc, 'Set Wall Centerline Location Line')
		trans6.Start()
		foptions = trans6.GetFailureHandlingOptions()
		foptions.SetFailuresPreprocessor(WarnSwallow())
		trans6.SetFailureHandlingOptions(foptions)
		for e in result:
			e.get_Parameter(BuiltInParameter.WALL_KEY_REF_PARAM).Set(0)
			#e.Flip()
		trans6.Commit()
	
		#Revit.Transaction.Transaction.End(doc)
		###STEP 7 SET INTERIOR LOCATION LINE###
		trans7 = Transaction(doc, 'Set Interior Location Line')
		trans7.Start()
		foptions = trans7.GetFailureHandlingOptions()
		foptions.SetFailuresPreprocessor(WarnSwallow())
		trans7.SetFailureHandlingOptions(foptions)
		for e in result:
			if locline == 1:
				lset = 3
			elif locline == 2:
				lset = 2
			elif locline == 3:
				lset = 0
			e.get_Parameter(BuiltInParameter.WALL_KEY_REF_PARAM).Set(locline)
			WallUtils.AllowWallJoinAtEnd(e,0)
			WallUtils.AllowWallJoinAtEnd(e,1)
		doc.Delete(duplicated.Id)
		trans7.Commit()
		tGroup.Assimilate()
		# Assign your output to the OUT variable.
		OUT = result
	else:
		trans3 = Transaction(doc, 'Deleting Temporary Wall Type')
		trans3.Start()
		foptions = trans3.GetFailureHandlingOptions()
		foptions.SetFailuresPreprocessor(WarnSwallow())
		trans3.SetFailureHandlingOptions(foptions)
		doc.Delete(duplicated.Id)	
		trans3.Commit()
		tGroup.Assimilate()
		OUT = None
else:
	OUT = None
# ----------------------------------------
VARout = Output(python_script)
