# Dynamo custom node ZK.BoundingBox.CenterPoint.dyf (Dynamo 2.1.0.7500)
# category: Synthesize.Packages.Zhukoven.Revit.BoundingBoxes
# Input Bounding Box element to get its center point. This node is little and lightweight, as it doesn't convert bounding box to geometry to get its centroid point.

VARBoundingBox = Input(VARBoundingBox: var[]..[])
minPoint = BoundingBox.MinPoint(boundingBox=VARBoundingBox)
maxPoint = BoundingBox.MaxPoint(boundingBox=VARBoundingBox)
byStartPointEndPoint = Line.ByStartPointEndPoint(startPoint=minPoint, endPoint=maxPoint)
code_block = CodeBlock { 0.5; }
pointAtParameter = Curve.PointAtParameter(curve=byStartPointEndPoint, param=code_block)
Point = Output(pointAtParameter)  # BoundingBoxcenterpoint
