# Dynamo custom node ZK.Document.GetWarnings.dyf (Dynamo 2.1.0.7500)
# category: Synthesize.Packages.Zhukoven.Revit.Document
# NOTE: Works only with Revit 2018 and above!
# Get all warnings from the current document.

VARRefresh = Input(VARRefresh: var[]..[])
python_script = Python(IN[0]=VARRefresh)
# ---------- python_script.python (23 lines) ----------
#Works only with Revit 2018+ and Dynamo 1.3.0+
#Author © Konstantin Zhukoven @ https:\\zhukoven.com
import clr
#Import Revit Services
clr.AddReference("RevitServices")
import RevitServices
from RevitServices.Persistence import DocumentManager

doc = DocumentManager.Instance.CurrentDBDocument
wlist = doc.GetWarnings()
refresh = IN[0]

if isinstance(wlist, list):
	wtext = wlist.GetDescriptionText()
	welt = wlist.GetFailingElements()
	wsev = wlist.GetSeverity()
else:
	wtext, welt, wsev = [], [], []
	for i in wlist:
		wtext.append(i.GetDescriptionText())
		welt.append(i.GetFailingElements())
		wsev.append(i.GetSeverity())
OUT = wtext, welt, wsev
# ----------------------------------------
code_block = CodeBlock(seq=python_script) { seq[0]; seq[1]; seq[2]; }
WarningText = Output(code_block.out0)  # Failuremessagestring
FailingElementIds = Output(code_block.out1)  # Idsofthefailingelements
FailureType = Output(code_block.out2)  # Failureseverity
