# Dynamo graph ---Send SOS Message to Karam---.dyn (Dynamo 2.13.1.3887)
# author: karam@aecedx.com

# group: Input
n01_your_name_required = StringInput("Ashraf Danadneh")  # "01.Your Name - Required"; graph input
n02_your_email_required = StringInput("ashrafdanadneh@gmail.com")  # "02.Your Email - Required"; graph input
n03_your_whatsapp_number_you_can = StringInput("+962xxxxxxxxx")  # "03.Your Whatsapp Number (You Can Change +962 to Your Country Code) - Required"; graph input
n04_script_you_re_facing_the = StringInput("Analyse.Basic Curve Length")  # "04.Script You're Facing The Problem With - Required"; graph input
n05_description_of_the_problem = StringInput("""The script gives me run completed with Errors, and I have updated Synthesize toolkit to it's latest version.
I've checked this link too :
https://www.aecedx.com/blog/revit/karam/synthesize-family-toolkit-installation-fixing/""")  # "05.Description of The Problem - Optional"; graph input
n06_link_to_download_your_project = StringInput("https://wetransfer.com/xxxxxx")  # "06.Link to Download your Project (Wetransfer Link for Example) - Optional"; graph input

python_script = Python(IN[0]=n01_your_name_required, IN[1]=n02_your_email_required, IN[2]=n03_your_whatsapp_number_you_can, IN[3]=n04_script_you_re_facing_the, IN[4]=n05_description_of_the_problem, IN[5]=n06_link_to_download_your_project)  # IronPython2
# ---------- python_script.python (54 lines) ----------
#Created by Karam Baki : karam@aecedx.com
import sys
sys.path.append(r'C:\Program Files (x86)\IronPython 2.7\DLLs')
sys.path.append(r'C:\Program Files (x86)\IronPython 2.7\Lib')
from System.Net import WebRequest
import urllib2
import urllib
import os
import clr
# Adding the DynamoRevitDS.dll module to work with the Dynamo API
clr.AddReference('DynamoRevitDS')
import Dynamo 
clr.AddReference('DSCoreNodes')
import DSCore
from DSCore import *
clr.AddReference("RevitServices")
from RevitServices.Persistence import DocumentManager
doc = DocumentManager.Instance.CurrentDBDocument
app = DocumentManager.Instance.CurrentUIApplication.Application

clr.AddReference("RevitAPIUI")
from Autodesk.Revit.UI import TaskDialog
# access to the current Dynamo instance and workspace
title = "AECedx - Karam"
alert = TaskDialog
try:
	name = IN[0].replace(",",".").replace('\n', ' ').replace('\r', '')
	email = IN[1].replace(",",".").replace('\n', ' ').replace('\r', '')
	whatsapp = IN[2].replace(",",".").replace('\n', ' ').replace('\r', '')
	script = IN[3].replace(",",".").replace('\n', ' ').replace('\r', '')
	description = IN[4].replace(",",".").replace('\n', ' ').replace('\r', '')
	download = IN[5].replace(",",".").replace('\n', ' ').replace('\r', '')
	information = name + "," + email + "," + whatsapp + "," + script + "," + description + "," + download
	data = [('sos',information)]
	continuework = True
	whatsapperror = False
	if whatsapp == "+962xxxxxxxxx":
		whatsapperror = True
	try:
		data = "?" + urllib.urlencode(data)
	except:
		continuework = False
		OUT = alert.Show(title, "ERROR, Please Use English Language Only")
	if continuework == True and whatsapperror == False:
		path = "http://dynamo.aecedx.net/sos.php" + data
		popup = "http://dynamo.aecedx.net/popup.php"
		req = urllib2.urlopen(path)
		msg = urllib2.urlopen(popup)
		msgread = msg.read()
		OUT = alert.Show(title, msgread)
	else:
		OUT = alert.Show(title, "ERROR, Please Enter Your Correct Data")
except:
	OUT = alert.Show(title, "Something Went Wrong, Are You Connected to Internet ?")
# ----------------------------------------
