# Dynamo graph Analyse.Basic Surface Area and Perimeter.dyn (Dynamo 2.13.1.3887)
# author: karam@aecedx.com
# packages: Synthesize toolkit 12.5.1

# group: Input
n01_select_surfaces = SelectFaces()  # "01.Select Surfaces"; nothing selected; graph input
n02_rounding_precision = DoubleInput(0.01)  # "02.Rounding Precision"; graph input

surface_importer = Custom[Surface Importer](VARSurfaces=n01_select_surfaces)  # package Synthesize toolkit; Surface Importer Node
surfaces = PolySurface.Surfaces(polySurface=surface_importer)
flatten = List.Flatten(list=surfaces)
area = Surface.Area(surface=flatten)
roundToPrecision = Custom[CW.Math.RoundToPrecision](VARdbl=area, VARprecision=n02_rounding_precision)  # package Synthesize toolkit; Rounds a number to a specified precision
sum = Math.Sum(values=area)
roundToPrecision_2 = Custom[CW.Math.RoundToPrecision](VARdbl=sum, VARprecision=n02_rounding_precision)
perimeter = Surface.Perimeter(surface=flatten)
roundToPrecision_3 = Custom[CW.Math.RoundToPrecision](VARdbl=perimeter, VARprecision=n02_rounding_precision)
sum_2 = Math.Sum(values=perimeter)
roundToPrecision_4 = Custom[CW.Math.RoundToPrecision](VARdbl=sum_2, VARprecision=n02_rounding_precision)

# group: Report
n01_surfaces_areas = Watch(roundToPrecision)  # "01.Surfaces Areas"; graph output
n02_total_area = Watch(roundToPrecision_2)  # "02.Total Area"; graph output
n03_surfaces_perimeters = Watch(roundToPrecision_3)  # "03.Surfaces Perimeters"; graph output
n04_total_perimeter = Watch(roundToPrecision_4)  # "04.Total Perimeter"; graph output

debug_python = Custom[Debug Python]()  # package Synthesize toolkit; Debug Python
