# Dynamo graph Analyse.Golden Ratio By Area.dyn (Dynamo 2.13.1.3887)
# author: karam@aecedx.com
# packages: Synthesize toolkit 12.5.1

# group: Input PreExcusion
# note: Synthesize toolkit by : Karam Baki
# Website : www.aecedx.com
# E-Mail : karam@aecedx.com
# note: Selection
# note: Input
n01_area = DoubleInput(0)  # "01.Area ?"; graph input

# group: Excusion - Formula
goldenRatio = Math.GoldenRatio()
# note: Excution
# note: Output
code_block = CodeBlock(a=n01_area, b=goldenRatio) { a/b; }
# note: Report
sqrt = Math.Sqrt(number=code_block)
code_block_2 = CodeBlock(a=sqrt, b=goldenRatio) { a*b; }

# group: Report Numbers
width = Watch(sqrt)  # "01.Width"; graph output
length = Watch(code_block_2)  # "02.Length"; graph output

debug_python = Custom[Debug Python]()  # package Synthesize toolkit; Debug Python
