# Dynamo graph Analyse.Golden Spiral By Formula.dyn (Dynamo 2.13.1.3887)
# author: karam@aecedx.com
# packages: Synthesize toolkit 12.5.1

number = DoubleInput(0.1)
number_slider = DoubleSlider(200, range=0..500 step 0.1)
number_2 = DoubleInput(0.1)
sequence = Sequence(start=number, amount=number_slider, step=number_2, lacing=Longest)
radiansToDegrees = Math.RadiansToDegrees(radians=sequence)
cos = Math.Cos(angle=radiansToDegrees)
E = Math.E()
number_slider_2 = DoubleSlider(0.5, range=0..2 step 0.001)
mul = sequence * number_slider_2
pow = Math.Pow(number=E, power=mul)
number_slider_3 = DoubleSlider(0.075, range=0..1 step 0.001)
mul_2 = pow * number_slider_3
mul_3 = cos * mul_2
sin = Math.Sin(angle=radiansToDegrees)
mul_4 = sin * mul_2
byCoordinates = Point.ByCoordinates(x=mul_3, y=mul_4)
byCenterPointRadius = Circle.ByCenterPointRadius(centerPoint=byCoordinates, radius=sequence)  # frozen
note = StringInput("This Script Needs to Run from Inside Dynamo, Please open it to use it.")  # "01.Note"; graph input

# group: Input
n04_create_selection_filter = BoolSelector(true)  # "04.Create Selection Filter ?"; graph input
n05_filter_name_to_create = StringInput("Dynamo Generated Golden Spiral")  # "05.Filter Name to Create"; graph input
n06_overwrite_existing_filter = BoolSelector(true)  # "06.Overwrite Existing Filter ? (False for Adding Elements)"; graph input
n03_select_center_circle = DSModelElementSelection()  # "03.Select Center Circle"; nothing selected; graph input

n02_detail_lines_false_model = BoolSelector(false)  # "02.Detail Lines = False | Model Lines = True"; graph input
code_block = CodeBlock { null; false; }
XY = Plane.XY()
start_range = DoubleInput(0)
end_range = DoubleInput(360)
steps = DoubleInput(20)
range = Range(start=start_range, end=end_range, step=steps, lacing=Longest)
rotate = Geometry.Rotate(geometry=byCoordinates, basePlane=XY, degrees=range, lacing=CrossProduct)
flatten = List.Flatten(list=rotate@L2)
transpose = List.Transpose(lists=flatten)
byControlPoints = NurbsCurve.ByControlPoints(points=transpose)
code_block_2 = CodeBlock { 0; }
byOrigin = CoordinateSystem.ByOrigin(x=code_block_2, y=code_block_2, z=code_block_2)
curves = Element.Curves(element=n03_select_center_circle)
centerPoint = Circle.CenterPoint(circle=curves)
X = Point.X(point=centerPoint)
Y = Point.Y(point=centerPoint)
Z = Point.Z(point=centerPoint)
byOrigin_2 = CoordinateSystem.ByOrigin(x=X, y=Y, z=Z)
transform = Geometry.Transform(geometry=byControlPoints, fromCoordinateSystem=byOrigin, contextCoordinateSystem=byOrigin_2, lacing=Longest)
flatten_2 = List.Flatten(list=transform)
scopeIf = Custom[CW.ScopeIf+](VARtest=n02_detail_lines_false_model, VARtrue=code_block.out0, VARfalse=flatten_2)  # package Synthesize toolkit; A (hopefully) more robust implementation of ScopeIf. Tests a single boolean and returns a value accordingly.
clean = List.Clean(list=scopeIf, preserveIndices=code_block.out1)
hot_get_revit_activeview = Custom[HOT.Get Revit ActiveView]()  # package Synthesize toolkit; Active View
fromCurve = Custom[CW.DetailLine.FromCurve](VARcurve=clean, VARview=hot_get_revit_activeview)  # package Synthesize toolkit; Creates a detail line based on a given curve
scopeIf_2 = Custom[CW.ScopeIf+](VARtest=n02_detail_lines_false_model, VARtrue=flatten_2, VARfalse=code_block.out0)
clean_2 = List.Clean(list=scopeIf_2, preserveIndices=code_block.out1)
byCurve = ModelCurve.ByCurve(curve=clean_2)
create = List.Create(item0=fromCurve, item1=byCurve)
clean_3 = List.Clean(list=create)
flatten_3 = List.Flatten(list=clean_3)
generate_selection_filter = Custom[Generate Selection Filter](VARCreateSelectionFilter=n04_create_selection_filter, VARFilterNametoCreate=n05_filter_name_to_create, VAROverwriteExistingFilter=n06_overwrite_existing_filter, VARElements=flatten_3)  # package Synthesize toolkit; Generate Selection FIlter
debug_python = Custom[Debug Python]()  # package Synthesize toolkit; Debug Python
