# Dynamo graph Analyse.K-Clash 1 Markers Create.dyn (Dynamo 2.13.1.3887)
# author: karam@aecedx.com
# packages: Synthesize toolkit 12.5.1

# group: Input
n01_inteference_report_file = Filename("No file selected.")  # "01.Inteference Report File (Navisworks XML or Revit HTML)"; graph input
n02_interference_family_name = StringInput("KClash_Interference Family")  # "02.Interference Family Name"; graph input
n03_cleanup_redundant_markers = BoolSelector(true)  # "03.Cleanup Redundant Markers Along The Way"; graph input
n04_kclash_views_section_box = DoubleInput(2.5)  # "04.KClash Views Section Box Extra Offset (Meters)"; graph input
n05_set_generate_3d_always_on = BoolSelector(true)  # "05.Set Generate 3D Always On ?"; graph input

k_clash = Custom[K-Clash](VARFilePath=n01_inteference_report_file, VARInterferenceFamily=n02_interference_family_name, VARCleanupalongtheway=n03_cleanup_redundant_markers, VARKClashViewsSectionBoxExtraOffsetMeters=n04_kclash_views_section_box, VARSetGenerate3DAlwaysOn=n05_set_generate_3d_always_on)  # package Synthesize toolkit; K-Clash
debug_python_no_message = Custom[Debug Python No Message]()  # package Synthesize toolkit; Debug Python
