# Dynamo graph Analyse.Sun Position.dyn (Dynamo 2.13.1.3887)
# author: karam@aecedx.com
# packages: Synthesize toolkit 12.5.1

# group: Input
n03_place_sun_family = BoolSelector(true)  # "03.Place Sun Family ?"; graph input
n01_select_targeted_elements_for = DSModelElementsSelection()  # "01.Select Targeted Elements (For Sun Positioning)"; nothing selected; graph input
n02_generating_distance = DoubleInput(25)  # "02.Generating Distance"; graph input

python_script = Python()  # IronPython2; unwired: IN[0]
# ---------- python_script.python (80 lines) ----------
import sys
sys.path.append(r'C:\Program Files (x86)\IronPython 2.7\DLLs')
sys.path.append(r'C:\Program Files (x86)\IronPython 2.7\Lib')
from System.Net import WebRequest
import urllib2
import urllib
import os
import clr
# Adding the DynamoRevitDS.dll module to work with the Dynamo API
clr.AddReference('DynamoRevitDS')
import Dynamo 
clr.AddReference('DSCoreNodes')
import DSCore
from DSCore import *
clr.AddReference('RevitAPI')
# Enable DocumentManager and TransactionManager
clr.AddReference('RevitServices')
from RevitServices.Persistence import DocumentManager
from RevitServices.Transactions import TransactionManager
# access to the current Dynamo instance and workspace
import System
from System.Collections.Generic import *
import clr
clr.AddReference('RevitAPI') 
import Autodesk
from Autodesk.Revit.DB import *
clr.AddReference('RevitAPIUI') 


clr.AddReference('ProtoGeometry')
from Autodesk.DesignScript.Geometry import *
clr.AddReference('RevitNodes')
import Revit
clr.ImportExtensions(Revit.GeometryConversion)

# Choose The Current Document
doc = DocumentManager.Instance.CurrentDBDocument
uidoc = DocumentManager.Instance.CurrentUIApplication.ActiveUIDocument
uiapp = DocumentManager.Instance.CurrentUIApplication
app = uiapp.Application

script = Dynamo.Applications.DynamoRevit().RevitDynamoModel.CurrentWorkspace.FileName.split("\\")[:-1]
fullpath = "\\".join(script) + "\\Sample Sun.rfa"

#Family symbol name to place.
symbName = 'Sample Sun'
 
#create a filtered element collector set to Category OST_Mass and Class FamilySymbol 
collector = FilteredElementCollector(doc)
collector.OfCategory(BuiltInCategory.OST_Entourage)
collector.OfClass(FamilySymbol)
famtypeitr = collector.GetElementIterator()

re = []
#Search Family Symbols in document.
for item in famtypeitr:
	famtypeID = item
	#re.append(item)
	if symbName in item.FamilyName:
		re = item
		break

if re == []:
	TransactionManager.Instance.EnsureInTransaction(doc)
	load = doc.LoadFamily(fullpath)
	TransactionManager.Instance.TransactionTaskDone()
	#create a filtered element collector set to Category OST_Mass and Class FamilySymbol 
	collector = FilteredElementCollector(doc)
	collector.OfCategory(BuiltInCategory.OST_GenericModel)
	collector.OfClass(FamilySymbol)
	famtypeitr = collector.GetElementIterator()
	#Search Family Symbols in document.
	for item in famtypeitr:
		famtypeID = item
		#re.append(item)
		if symbName in item.FamilyName:
			re = item
			break

OUT = re
# ----------------------------------------
code_block = CodeBlock { null; }
scopeIf = Custom[CW.ScopeIf+](VARtest=n03_place_sun_family, VARtrue=python_script, VARfalse=code_block)  # package Synthesize toolkit; A (hopefully) more robust implementation of ScopeIf. Tests a single boolean and returns a value accordingly.
create = List.Create(item0=scopeIf)
flatten = List.Flatten(list=create)
code_block_2 = CodeBlock { false; }
clean = List.Clean(list=flatten, preserveIndices=code_block_2)
batch_elements_bounding_box = Custom[Batch Elements Bounding Box](VARElements=n01_select_targeted_elements_for)  # package Synthesize toolkit; Batch Elements Bounding Box
centerPoint = Custom[ZK.BoundingBox.CenterPoint](VARBoundingBox=batch_elements_bounding_box)  # package Synthesize toolkit; Input Bounding Box element to get its center point. This node is little and lightweight, as it doesn't convert bounding box to geometry to get its centroid point.
XYZ = Custom[LF.Point.XYZ](VARpoint=centerPoint)  # package Synthesize toolkit; Get the X, Y, and Z components of a Point
byOrigin = CoordinateSystem.ByOrigin(x=XYZ.VARX, y=XYZ.VARY, z=XYZ.VARZ)
current = SunSettings()  # "SunSettings.Current"
sunDirection = SunSettings.SunDirection(sunSettings=current)
translate = CoordinateSystem.Translate(coordinateSystem=byOrigin, direction=sunDirection, distance=n02_generating_distance)
origin = CoordinateSystem.Origin(coordinateSystem=translate)
byPoint = FamilyInstance.ByPoint(familyType=clean, point=origin)
azimuth = SunSettings.Azimuth(sunSettings=current)
n01_sun_azimuth = Watch(azimuth)  # "01.Sun Azimuth"; graph output
altitude = SunSettings.Altitude(sunSettings=current)
n02_sun_altitude = Watch(altitude)  # "02.Sun Altitude"; graph output
currentDateTime = SunSettings.CurrentDateTime(sunSettings=current)
n03_current_date_and_time = Watch(currentDateTime)  # "03.Current Date and Time"; graph output
debug_python = Custom[Debug Python]()  # package Synthesize toolkit; Debug Python
