# Dynamo graph Analyse.Topo Analysis Create.dyn (Dynamo 2.13.1.3887)
# author: karam@aecedx.com
# packages: Synthesize toolkit 12.5.1

debug_python_no_message = Custom[Debug Python No Message]()  # package Synthesize toolkit; Debug Python
code_block = CodeBlock { true; false; "DONOTDELETE-Dynamo Topo Analysis"; }

# group: Input
n02_slope_analysis_false = BoolSelector(false)  # "02.Slope Analysis = False | Elevation Map Analsysis = True"; graph input
n01_select_topography_subregion = DSModelElementSelection()  # "01.Select Topography/Subregion"; nothing selected; graph input
n04_full_topography_analysis = BoolSelector(false)  # "04.Full Topography Analysis ?"; graph input
hot_get_revit_activeview = Custom[HOT.Get Revit ActiveView]()  # package Synthesize toolkit; Active View
n05_group_name_to_create_slope = StringInput("Dynamo K-Slope Analysis")  # "05.Group Name to create (Slope Analysis)"; graph input
category_of_the_analysis = Categories("OST_Site")  # "Category of the Analysis surfaces"
start_factor = DoubleInput(10000)
n06_group_name_to_create = StringInput("Dynamo K-Elevation Analysis")  # "06.Group Name to create (Elevation Analysis)"; graph input

code_block_2 = CodeBlock { null; }
code_block_3 = CodeBlock { true; }
ne = n04_full_topography_analysis != code_block_3
select_topography_from_subregion = Custom[Select Topography From Subregion](VARTopography=n01_select_topography_subregion, VARLeaveAsIs=ne)  # package Synthesize toolkit; Select Topography From Subregion
scopeIf = Custom[CW.ScopeIf+](VARtest=n02_slope_analysis_false, VARtrue=code_block_2, VARfalse=select_topography_from_subregion)  # package Synthesize toolkit; A (hopefully) more robust implementation of ScopeIf. Tests a single boolean and returns a value accordingly.
scopeIf_2 = Custom[CW.ScopeIf+](VARtest=n02_slope_analysis_false, VARtrue=code_block_2, VARfalse=hot_get_revit_activeview)
scopeIf_3 = Custom[CW.ScopeIf+](VARtest=n02_slope_analysis_false, VARtrue=code_block_2, VARfalse=n05_group_name_to_create_slope)
scopeIf_4 = Custom[CW.ScopeIf+](VARtest=n02_slope_analysis_false, VARtrue=code_block_2, VARfalse=category_of_the_analysis)
scopeIf_5 = Custom[CW.ScopeIf+](VARtest=n02_slope_analysis_false, VARtrue=code_block_2, VARfalse=start_factor)
n03_extend_to_all_views = BoolSelector(true)  # "03.Extend to All Views ?"; graph input
slope_analysis = Custom[Slope Analysis](VARTopography=scopeIf, VARActiveView=scopeIf_2, VARGroupName=scopeIf_3, VARCategory=scopeIf_4, VARStartFactor=scopeIf_5, VARFullTopo=n04_full_topography_analysis, VARAllViews=n03_extend_to_all_views)  # package Synthesize toolkit; Slope Analysis
scopeIf_6 = Custom[CW.ScopeIf+](VARtest=n02_slope_analysis_false, VARtrue=select_topography_from_subregion, VARfalse=code_block_2)
scopeIf_7 = Custom[CW.ScopeIf+](VARtest=n02_slope_analysis_false, VARtrue=hot_get_revit_activeview, VARfalse=code_block_2)
scopeIf_8 = Custom[CW.ScopeIf+](VARtest=n02_slope_analysis_false, VARtrue=n06_group_name_to_create, VARfalse=code_block_2)
scopeIf_9 = Custom[CW.ScopeIf+](VARtest=n02_slope_analysis_false, VARtrue=category_of_the_analysis, VARfalse=code_block_2)
scopeIf_10 = Custom[CW.ScopeIf+](VARtest=n02_slope_analysis_false, VARtrue=start_factor, VARfalse=code_block_2)
elevation_analysis = Custom[Elevation Analysis](VARTopography=scopeIf_6, VARActiveView=scopeIf_7, VARGroupName=scopeIf_8, VARCategory=scopeIf_9, VARStartFactor=scopeIf_10, VARFullTopo=n04_full_topography_analysis, VARAllViews=n03_extend_to_all_views)  # package Synthesize toolkit; Elevation Analysis
create = List.Create(item0=slope_analysis.VAROverriddenTopography, item1=elevation_analysis.VAROverriddenTopography)
code_block_4 = CodeBlock { false; }
clean = List.Clean(list=create, preserveIndices=code_block_4)
flatten = List.Flatten(list=clean)
generate_selection_filter = Custom[Generate Selection Filter](VARCreateSelectionFilter=code_block.out0, VARFilterNametoCreate=code_block.out2, VAROverwriteExistingFilter=code_block.out1, VARElements=flatten)  # package Synthesize toolkit; Generate Selection FIlter
