# Dynamo graph Analyse.Topo Analysis Delete.dyn (Dynamo 2.13.1.3887)
# author: karam@aecedx.com
# packages: Synthesize toolkit 12.5.1

typeCollector = Custom[BVN.ModelGroup.TypeCollector]()  # package Synthesize toolkit; Returns all the types (not instances) from all model groups in the project
code_block = CodeBlock { "Type Name"; }
getParameterValueByName = Element.GetParameterValueByName(element=typeCollector, parameterName=code_block)

# group: Input
n02_elevation_analysis_to_clean = StringInput("Dynamo K-Elevation Analysis")  # "02.Elevation Analysis to clean up"; graph input
n03_slope_analysis_to_clean_up = StringInput("Dynamo K-Slope Analysis")  # "03.Slope Analysis to clean up"; graph input
n01_remove_transparancy_from = BoolSelector(true)  # "01.Remove Transparancy from Topography in All Views ?"; graph input

create = List.Create(item0=n02_elevation_analysis_to_clean, item1=n03_slope_analysis_to_clean_up)
eq = getParameterValueByName@L1 == create
anyTrue = Custom[CW.List.AnyTrue](VARseq=eq)  # package Synthesize toolkit; Returns true if any item in a list of booleans is true.
filterByBoolMask = List.FilterByBoolMask(list=typeCollector, mask=anyTrue)
modelGroupByName = Custom[RH.Collector.ModelGroupByName](VARgroupName=create@L1)  # package Synthesize toolkit; This will collect all instances of a model group by given name.
code_block_2 = CodeBlock { false; }
clean = List.Clean(list=modelGroupByName, preserveIndices=code_block_2)
flatten = List.Flatten(list=clean)
eraser = Custom[ST.Tool.Eraser](VARList=flatten)  # package Synthesize toolkit; Try to delete any element from project
passthrough = Custom[CW.Passthrough](VARpassThrough=filterByBoolMask.in, VARwaitFor=eraser)  # package Synthesize toolkit; Forces a sequential order of execution. The node wired into the output of the Passthrough node will be executed *after* the node wired into the waitFor input (e.g. important for some Revit operations). The value of the passThrough input will be passed on to the node wired into the output port of the Passthrough node.
flatten_2 = List.Flatten(list=passthrough)
eraser_2 = Custom[ST.Tool.Eraser](VARList=flatten_2)
debug_python_no_message = Custom[Debug Python No Message]()  # package Synthesize toolkit; Debug Python
hot_get_all_filter = Custom[HOT.Get All Filter]()  # package Synthesize toolkit; Get all Filter
code_block_3 = CodeBlock { "DONOTDELETE-Dynamo Topo Analysis"; }
eq_2 = hot_get_all_filter.VARName == code_block_3
filterByBoolMask_2 = List.FilterByBoolMask(list=hot_get_all_filter.VARElement, mask=eq_2)
elements = Custom[CW.SelectionSet.Elements](VARselectionSet=filterByBoolMask_2.in)  # package Synthesize toolkit; Retrieves all elements stored in a selection set
flatten_3 = List.Flatten(list=elements)
views = Custom[CW.Document.Views]()  # package Synthesize toolkit; Gets all views in the document - except for 3D view templates (as long as this bug is not fixed: https://github.com/DynamoDS/Dynamo/issues/2970)
hot_get_revit_activeview = Custom[HOT.Get Revit ActiveView]()  # package Synthesize toolkit; Active View
scopeIf = Custom[CW.ScopeIf+](VARtest=n01_remove_transparancy_from, VARtrue=views, VARfalse=hot_get_revit_activeview)  # package Synthesize toolkit; A (hopefully) more robust implementation of ScopeIf. Tests a single boolean and returns a value accordingly.
code_block_4 = CodeBlock { 0; }
overrideTransparencyInView = Custom[CW.Element.OverrideTransparencyInView](VARelement=flatten_3, VARview=scopeIf@L1, VARtransparencyPercentage=code_block_4)  # package Synthesize toolkit; Overrides the transparency of an element in a given view
passthrough_2 = Custom[CW.Passthrough](VARpassThrough=filterByBoolMask_2.in, VARwaitFor=overrideTransparencyInView)
eraser_3 = Custom[ST.Tool.Eraser](VARList=passthrough_2)
