# Dynamo graph Conceptual.Adaptive Generate Lines Offset Family.dyn (Dynamo 2.13.1.3887)
# author: karam@aecedx.com
# packages: Synthesize toolkit 12.5.1

debug_python_no_message = Custom[Debug Python No Message]()  # package Synthesize toolkit; Debug Python

# group: Input
n01_points_number = DoubleInput(4)  # "01.Points Number"; graph input
n02_points_offset_in_meters = DoubleInput(1)  # "02.Points Offset (In Meters)"; graph input
n04_offset_parameter_name = StringInput("Offset")  # "04.Offset Parameter Name"; graph input
n06_offset_parameter_group_pg = BuiltInParameterGroup("PG_GEOMETRY")  # "06.Offset Parameter: Group (PG_Geometry is Dimensions)"; graph input
n05_offset_parameter_is_instance = BoolSelector(true)  # "05.Offset Parameter Is Instance ?"; graph input
n03_maximum_possible_length_in = DoubleInput(100)  # "03.Maximum Possible Length (In Meters)"; graph input
n09_is_family_shared = BoolSelector(false)  # "09.Is Family Shared ?"; graph input
n07_family_name = StringInput("Dynamo Adaptive Offset")  # "07.Family Name"; graph input
n08_family_template_of_adaptive = Filename("..\..\..\..\..\..\..\..\..\..\ProgramData\Autodesk\RVT 2020\Family Templates\English\Metric Generic Model.rft")  # "08.Family Template of Adaptive Family"; graph input

convert_between_units = DynamoConvert(n02_points_offset_in_meters, MeasurementType="Length", FromConversion="Meters", ToConversion="Feet")
translate_builtin_parameter = Custom[Translate BuiltIn Parameter Group](VARBuiltInParameterGroupString=n06_offset_parameter_group_pg)  # package Synthesize toolkit; Translate BuiltIn Parameter Group
convert_between_units_2 = DynamoConvert(n03_maximum_possible_length_in, MeasurementType="Length", FromConversion="Meters", ToConversion="Feet")
category = Categories("OST_AdaptivePoints")
smart_rft_path = Custom[Smart RFT Path](VARRFTFile=n08_family_template_of_adaptive, VARCategory=category)  # package Synthesize toolkit; Smart RFT Path
python_script = Python(IN[0]=n01_points_number, IN[1]=convert_between_units, IN[2]=n04_offset_parameter_name, IN[3]=translate_builtin_parameter, IN[4]=n05_offset_parameter_is_instance, IN[5]=convert_between_units_2, IN[6]=n09_is_family_shared, IN[7]=n07_family_name, IN[8]=n01_points_number, IN[9]=category, IN[10]=smart_rft_path)  # IronPython2
# ---------- python_script.python (359 lines) ----------
# Proudly Created By: Karam Baki karam@aecedx.com
import clr
clr.AddReference('ProtoGeometry')
from Autodesk.DesignScript import Geometry as dg
clr.AddReference('RevitAPI')
from Autodesk.Revit.DB import*
clr.AddReference('RevitServices')
from RevitServices.Persistence import DocumentManager
from RevitServices.Transactions import TransactionManager
from Autodesk.Revit.Creation.FamilyItemFactory import NewReferencePoint
clr.AddReference('RevitNodes')
import Revit
clr.ImportExtensions(Revit.GeometryConversion)
import System
pf_path = System.Environment.GetFolderPath(System.Environment.SpecialFolder.ProgramFilesX86)
import sys
sys.path.append('%s\IronPython 2.7\Lib' %pf_path)
import traceback
import random
import string
import re

# Family Load Options Class - Without Overwriting Parameters
class FamOptWithout(IFamilyLoadOptions):
	def __init__(self):
		pass
	def OnFamilyFound(self,familyInUse, overwriteParameterValues):
		overwriteParameterValues.Value = False
		return True
	def OnSharedFamilyFound(self,familyInUse, source, overwriteParameterValues):
		overwriteParameterValues.Value = False
		return True

# Simple Warning Swallow Class
class WarnSwallowSimple(IFailuresPreprocessor):
	def PreprocessFailures(self, failuresAccessor):
		failuresAccessor.DeleteAllWarnings()
		return FailureProcessingResult.Continue

# Create New Family
def createfamily(fam_path,doc,famname,famcategory,isShared,isWorkplane,isVertical,isCuts):
	save_path = '%s%s.rfa' % (temp_path, famname)
	famdoc = doc.Application.NewFamilyDocument(fam_path)
	try:
		TransactionManager.Instance.ForceCloseTransaction()
		trans1 = Transaction(famdoc, 'New ' + famname + ' Family')
		trans1.Start()
		warnhandle = WarnSwallowSimple()
		foptions = trans1.GetFailureHandlingOptions()
		foptions.SetFailuresPreprocessor(warnhandle)
		trans1.SetFailureHandlingOptions(foptions)
		transferunit(doc,famdoc)
		try:
			fam_cat = famdoc.Settings.Categories.get_Item(famcategory)
			famdoc.OwnerFamily.FamilyCategory = fam_cat
		except:
			pass
		getfamtype(famdoc)
		if isShared == True:
			try:famdoc.OwnerFamily.get_Parameter(BuiltInParameter.FAMILY_SHARED).Set(1)
			except:pass
		else:
			try:famdoc.OwnerFamily.get_Parameter(BuiltInParameter.FAMILY_SHARED).Set(0)
			except:pass
		if isWorkplane == True:
			try:famdoc.OwnerFamily.get_Parameter(BuiltInParameter.FAMILY_WORK_PLANE_BASED).Set(1)
			except:pass
		else:
			try:famdoc.OwnerFamily.get_Parameter(BuiltInParameter.FAMILY_WORK_PLANE_BASED).Set(0)
			except:pass
		if isVertical == True:
			try:famdoc.OwnerFamily.get_Parameter(BuiltInParameter.FAMILY_ALWAYS_VERTICAL).Set(1)
			except:pass
		else:
			try:famdoc.OwnerFamily.get_Parameter(BuiltInParameter.FAMILY_ALWAYS_VERTICAL).Set(0)
			except:pass
		if isCuts == True:
			try:famdoc.OwnerFamily.get_Parameter(BuiltInParameter.FAMILY_ALLOW_CUT_WITH_VOIDS).Set(1)
			except:pass
		else:
			try:famdoc.OwnerFamily.get_Parameter(BuiltInParameter.FAMILY_ALLOW_CUT_WITH_VOIDS).Set(0)
			except:pass
		trans1.Commit()
		famdoc.SaveAs(save_path, SaveAsOpt)
		loaded = famdoc
	except:
		try:
			trans1.Commit()
		except:
			pass
		TransactionManager.Instance.ForceCloseTransaction()
		try:famdoc.Close(False)
		except:pass
		try:System.IO.File.Delete(save_path)
		except:pass
		loaded = None
	return loaded,save_path

# Transfer Document Units
def transferunit(doc,famdoc):
	if int(DocumentManager.Instance.CurrentUIApplication.Application.VersionNumber) < 2021:
		unit = famdoc.GetUnits()
		currectformat = doc.GetUnits().GetFormatOptions(UnitType.UT_Length)
		accuracy = currectformat.Accuracy
		unit.SetFormatOptions(UnitType.UT_Length,FormatOptions(currectformat.DisplayUnits,accuracy))
		famdoc.SetUnits(unit)
	else:
		unit = famdoc.GetUnits()
		currectformat = doc.GetUnits().GetFormatOptions(SpecTypeId.Length)
		unit.SetFormatOptions(SpecTypeId.Length,currectformat)
		famdoc.SetUnits(unit)

def getfamtype(famdoc,famtypename = None):
	alltypes = famdoc.FamilyManager.Types
	if len(list(alltypes)) == 1 or famtypename == None:
		famtype = famdoc.FamilyManager.CurrentType
	elif len(list(alltypes)) == 0 or famtypename == None:
		famtype = famdoc.FamilyManager.NewType(famtypename)
		famdoc.FamilyManager.CurrentType = famtype
	else:
		for t in alltypes:
			if t.Name == famtypename:
				famdoc.FamilyManager.CurrentType = t
				famtype = t
				break
	return famtype

def newrefpt(doc,refpt,option):
	if option == 1:
		r = refpt.GetCoordinatePlaneReferenceXY()
		re = app.Create.NewPointOnPlane(r,UV(),UV(),0)
		pts = doc.FamilyCreate.NewReferencePoint(re)
	elif option == 2:
		r = refpt.GetCoordinatePlaneReferenceYZ()
		re = app.Create.NewPointOnPlane(r,UV(),UV(),0)
		pts = doc.FamilyCreate.NewReferencePoint(re)
	elif option == 3:	
		r = refpt.GetCoordinatePlaneReferenceXZ()
		re = app.Create.NewPointOnPlane(r,UV(),UV(),0)
		pts = doc.FamilyCreate.NewReferencePoint(re)
	else:
		pts = "Please Choose Proper Option : 1, 2 or 3"
	return pts

def isgood(opt,pt,surface,checksurf=True):
	perm = surface.PerimeterCurves()
	plane = dg.Plane.ByOriginNormal(opt.GetCoordinateSystem().Origin.ToPoint(),dg.Vector.ZAxis())
	if dg.Geometry.DoesIntersect(pt,plane) == False:
		return False
	for p in perm:
		if dg.Geometry.DoesIntersect(pt,p):
			return False
	if checksurf:
		if dg.Geometry.DoesIntersect(pt,surface) == False:
			return False
	return True

def islinegood(opt,line,surface):
	stp = line.StartPoint
	enp = line.EndPoint
	status1 = isgood(opt,stp,surface,False)
	status2 = isgood(opt,enp,surface,False)
	status3 = True
	perm = surface.PerimeterCurves()
	for p in perm:
		if dg.Geometry.DoesIntersect(p,line):
			status3 = False
			break
	if status1 and status2 and status3:
		return True
	else:
		return False

def addorgetparam(doc,defnametoadd,offset,pgroup,ismatinstance):
	getfamtype(doc,doc.Title)
	try:
		famnewpar = doc.FamilyManager.AddParameter(defnametoadd,pgroup,ParameterType.Length,ismatinstance)
	except:
		existedparams = doc.FamilyManager.GetParameters()
		for existedp in existedparams:
			if existedp.Definition.Name == defnametoadd:
				famnewpar = existedp
				if (ismatinstance and existedp.IsInstance) or (ismatinstance == False and existedp.IsInstance == False):
					break
				elif ismatinstance:
					doc.FamilyManager.MakeInstance(famnewpar)
				else:
					doc.FamilyManager.MakeType(famnewpar)
				break
	doc.FamilyManager.Set(famnewpar,offset)
	return famnewpar

def smartOffsetOP(doc,sides,offset,defnametoadd,pgroup,ismatinstance,linefactor):
	TransactionManager.Instance.ForceCloseTransaction()
	trans1 = Transaction(doc, 'Adaptive Offset Magic')
	trans1.Start()
	warnhandle = WarnSwallowSimple()
	foptions = trans1.GetFailureHandlingOptions()
	foptions.SetFailuresPreprocessor(warnhandle)
	trans1.SetFailureHandlingOptions(foptions)
	if int(DocumentManager.Instance.CurrentUIApplication.Application.VersionNumber) < 2021:
		anglefactor = UnitUtils.ConvertToInternalUnits(1,doc.GetUnits().GetFormatOptions(UnitType.UT_Angle).DisplayUnits)
	else:
		anglefactor = UnitUtils.ConvertToInternalUnits(1,doc.GetUnits().GetFormatOptions(SpecTypeId.Angle).GetUnitTypeId())
	
	if int(DocumentManager.Instance.CurrentUIApplication.Application.VersionNumber) < 2021:
		fivemeters = UnitUtils.ConvertFromInternalUnits(16.4042,doc.GetUnits().GetFormatOptions(UnitType.UT_Length).DisplayUnits)
	else:
		fivemeters = UnitUtils.ConvertFromInternalUnits(16.4042,doc.GetUnits().GetFormatOptions(SpecTypeId.Length).GetUnitTypeId())
	refpoints = []
	sides = dg.Geometry.Explode(dg.Geometry.Rotate(dg.Polygon.RegularPolygon(dg.Circle.ByCenterPointRadius(dg.Point.Origin(),fivemeters),sides),dg.Point.Origin(),dg.Vector.ZAxis(),45))
	for side in sides:
		refpoints.append(doc.FamilyCreate.NewReferencePoint(side.StartPoint.ToXyz()))
	doc.Regenerate()
	pts = []
	count = 0
	for p in refpoints:
		ptlist = ReferencePointArray()
		ptlist.Append(refpoints[count])
		ptlist.Append(refpoints[count-1])
		count += 1
		line = doc.FamilyCreate.NewCurveByPoints(ptlist)
		line.LookupParameter("Is Reference Line").Set(1)
		line.LookupParameter("Reference").Set(0)
		doc.Regenerate()
		geomoptions = Options()
		geomoptions.ComputeReferences = True
		geoms = line.get_Geometry(geomoptions)
		for geom in geoms:
			Lref = geom.Reference
		loc = PointLocationOnCurve(PointOnCurveMeasurementType.NormalizedCurveParameter,0.5,PointOnCurveMeasureFrom.Beginning)
		midref = app.Create.NewPointOnEdge(Lref,loc)
		refpt = doc.FamilyCreate.NewReferencePoint(midref)
		pts.append(refpt)
	dynpts = []
	for pt in refpoints:
		pt.LookupParameter("Point").Set(1)
		dynpts.append(pt.GetCoordinateSystem().Origin.ToPoint())
	surface = dg.Surface.ByPatch(dg.Polygon.ByPoints(dynpts))
	doc.Regenerate()
	famnewpar = addorgetparam(doc,defnametoadd,offset,pgroup,ismatinstance)
	factorfamnewpar = addorgetparam(doc,"Line Factor " + defnametoadd,linefactor,BuiltInParameterGroup.INVALID,False)
	inversefactorfamnewpar = addorgetparam(doc,"Line Factor Inverse " + defnametoadd,linefactor,BuiltInParameterGroup.INVALID,False)
	doc.FamilyManager.SetFormula(inversefactorfamnewpar,"-1* Line Factor " + defnametoadd)
	count = 0
	result = []
	lines = []
	for p in pts:
		safe = False
		opt = 1
		while safe == False:
			pnew = newrefpt(doc,p,opt)
			pnew.LookupParameter("Offset").Set(offset)
			doc.Regenerate()
			pt = pnew.GetCoordinateSystem().Origin.ToPoint()
			if isgood(p,pt,surface) == False:
				doc.Delete(pnew.Id)
				opt += 1
			else:
				p = pnew
				safe = True
				break
			if opt > 3:
				opt = 1
				oldangle = p.LookupParameter("Rotation Angle").AsDouble()
				newangle = (90 * anglefactor) + oldangle
				p.LookupParameter("Rotation Angle").Set(newangle)
		param = p.LookupParameter("Offset")
		doc.FamilyManager.AssociateElementParameterToFamilyParameter(param,famnewpar)
		result.append(p)
		safe = False
		opt = 1
		while safe == False:
			pL1 = newrefpt(doc,p,opt)
			pL1.LookupParameter("Offset").Set(offset)
			pL2 = newrefpt(doc,p,opt)
			pL2.LookupParameter("Offset").Set(-1.0*offset)
			ptlist = ReferencePointArray()
			ptlist.Append(pL1)
			ptlist.Append(pL2)
			doc.Regenerate()
			testline = dg.Line.ByStartPointEndPoint(pL1.GetCoordinateSystem().Origin.ToPoint(),pL2.GetCoordinateSystem().Origin.ToPoint())
			if islinegood(p,testline,surface) == False:
				doc.Delete(pL1.Id)
				doc.Delete(pL2.Id)
				opt += 1
			else:
				parm1 = pL1.LookupParameter("Offset")
				doc.FamilyManager.AssociateElementParameterToFamilyParameter(parm1,factorfamnewpar)
				parm2 = pL2.LookupParameter("Offset")
				doc.FamilyManager.AssociateElementParameterToFamilyParameter(parm2,inversefactorfamnewpar)
				line = doc.FamilyCreate.NewCurveByPoints(ptlist)
				safe = True
				break
		line.LookupParameter("Is Reference Line").Set(1)
		line.LookupParameter("Reference").Set(0)
		lines.append(line)
	intpts = []
	count = 0
	for line in lines:
		line1 = lines[count]
		line2 = lines[count-1]
		count += 1
		intpt = app.Create.NewPointOnEdgeEdgeIntersection(Reference(line1),Reference(line2))
		intpts.append(doc.FamilyCreate.NewReferencePoint(intpt))
	doc.Regenerate()
	lines = []
	count = 0
	for pt in intpts:
		ptlist = ReferencePointArray()
		ptlist.Append(intpts[count])
		ptlist.Append(intpts[count-1])
		count += 1
		line = doc.FamilyCreate.NewCurveByPoints(ptlist)
		lines.append(line)
	trans1.Commit()
	return lines

sides = IN[0]
offset = IN[1]
defnametoadd = IN[2]
pgroup = UnwrapElement(IN[3])
ismatinstance = IN[4]
linefactor = IN[5]
isShared = IN[6]
famname = IN[7]
famnumber = int(IN[8])
famcategory = UnwrapElement(IN[9])
fam_path = IN[10]

temp_path = System.IO.Path.GetTempPath()

# Project Document and UI
projectdoc = DocumentManager.Instance.CurrentDBDocument
uiapp = DocumentManager.Instance.CurrentUIApplication
app = uiapp.Application

# Family Saving Options
SaveAsOpt = SaveAsOptions()
SaveAsOpt.OverwriteExistingFile = True

# Stabelizing Category Name
try:
	famcategory = famcategory.Name
except:
	pass

famdoc = createfamily(fam_path,projectdoc,famname + " " + str(famnumber),famcategory,False,False,False,False)
try:
	smartOffsetOP(famdoc[0],sides,offset,defnametoadd,pgroup,ismatinstance,linefactor)
	loaded = famdoc[0].LoadFamily(projectdoc,FamOptWithout())
except:
	pass
famdoc[0].Close(False)
if famdoc[1] != None:
	System.IO.File.Delete(famdoc[1])
SaveAsOpt.Dispose()	

OUT = loaded
# ----------------------------------------
