# Dynamo graph Conceptual.Adaptive K-Rigger By Masses - Multple Selection.dyn (Dynamo 2.13.1.3887)
# author: karam@aecedx.com
# packages: Synthesize toolkit 12.5.1

# group: Input
n01_select_multiple_masses_to_rig = DSModelElementsSelection()  # "01.Select Multiple Masses to Rig (Doesn't Work With Joined Masses)"; nothing selected; graph input
n02_select_reference_point_origin = DSModelElementSelection()  # "02.Select Reference Point (Origin)"; nothing selected; graph input
n10_new_x = DoubleInput(1)  # "10.New X"; graph input
n09_old_x = DoubleInput(1)  # "09.Old X"; graph input
n12_new_y = DoubleInput(1)  # "12.New Y"; graph input
n11_old_y = DoubleInput(1)  # "11.Old Y"; graph input
n14_new_z = DoubleInput(1)  # "14.New Z"; graph input
n13_old_z = DoubleInput(1)  # "13.Old Z"; graph input
n15_generic_family_template = Filename("..\..\..\ProgramData\Autodesk\RVT 2020\Family Templates\English\Metric Generic Model.rft")  # "15.Generic Family Template"; graph input
n16_adaptive_family_template = Filename("..\..\..\ProgramData\Autodesk\RVT 2020\Family Templates\English\Metric Generic Model Adaptive.rft")  # "16.Adaptive Family Template"; graph input
n07_is_instance_parameters = BoolSelector(true)  # "07.Is Instance Parameters ?"; graph input
n05_form_family_name = StringInput("Form")  # "05.Form Family Name"; graph input
n08_update_mode_false_will_auto = BoolSelector(false)  # "08.Update Mode - False Will Auto Increment"; graph input
n06_form_family_number = DoubleInput(1)  # "06.Form Family Number"; graph input
material = StringInput("Default")  # "03.Material"; graph input
n04_is_shared = BoolSelector(false)  # "04.Is Shared ?"; graph input

element_geometry_fixer = Custom[Element.Geometry Fixer](VARElement=n01_select_multiple_masses_to_rig)  # package Synthesize toolkit; Element.Geometry Fixer
code_block = CodeBlock { false; }
clean = List.Clean(list=element_geometry_fixer, preserveIndices=code_block)
flatten = List.Flatten(list=clean)
turnIntoList = Custom[CW.TurnIntoList](VARunknownItem=n02_select_reference_point_origin)  # package Synthesize toolkit; Turns an element (or a nested list) into a flat list
point = ReferencePoint.Point(referencePoint=turnIntoList)
byOrigin = CoordinateSystem.ByOrigin(origin=point)
XYPlane = CoordinateSystem.XYPlane(coordinateSystem=byOrigin)
div = n10_new_x / n09_old_x
div_2 = n12_new_y / n11_old_y
div_3 = n14_new_z / n13_old_z
scale = Geometry.Scale(geometry=flatten, plane=XYPlane, xamount=div, yamount=div_2, zamount=div_3, lacing=Longest)
origin = Point.Origin()
byOrigin_2 = CoordinateSystem.ByOrigin(origin=origin)
transform = Geometry.Transform(geometry=scale, fromCoordinateSystem=byOrigin, contextCoordinateSystem=byOrigin_2, lacing=Longest)
dynamo_geometry_to_revit = Custom[Dynamo Geometry To Revit Compatibility](VARGeometryOrSat=transform)  # package Synthesize toolkit; Dynamo Geometry To Revit Compatibility
flatten_2 = List.Flatten(list=dynamo_geometry_to_revit)
categories = Categories("OST_GenericModel")
smart_rft_path = Custom[Smart RFT Path](VARRFTFile=n15_generic_family_template, VARCategory=categories)  # package Synthesize toolkit; Smart RFT Path
categories_2 = Categories("OST_AdaptivePoints")
smart_rft_path_2 = Custom[Smart RFT Path](VARRFTFile=n16_adaptive_family_template, VARCategory=categories_2)
code_block_2 = CodeBlock { "[0-9]+"; }
categories_3 = Categories("OST_GenericModel")
all_elements_of_category = ElementsOfCategory(Category=categories_3)
get_family_and_type_name_by = Custom[Get Family and Type Name By Family Instance](VARFamilyInstance=all_elements_of_category)  # package Synthesize toolkit; Get Family and Type Name
code_block_3 = CodeBlock { "K-Rig Form"; }
endsWith = String.EndsWith(string=get_family_and_type_name_by.VARFamilyName, searchFor=code_block_3)
code_block_4 = CodeBlock { ""; }
eq = endsWith == code_block_4
filterByBoolMask = List.FilterByBoolMask(list=get_family_and_type_name_by.VARFamilyName, mask=eq)
findRegularExpression = Custom[CW.String.FindRegularExpression](VARRegEx=code_block_2, VARstr=filterByBoolMask.out)  # package Synthesize toolkit; Returns all occurences of a regular expression within a string (or list of strings). The syntax for regular expressions is explained at http://ironpython-test.readthedocs.org/en/latest/howto/regex.html
flatten_3 = List.Flatten(list=findRegularExpression)
toNumber = String.ToNumber(string=flatten_3)
uniqueItems = List.UniqueItems(list=toNumber)
sort = List.Sort(list=uniqueItems)
list_lastitem_fixer = Custom[List.LastItem Fixer](VARlist=sort)  # package Synthesize toolkit; List.LastItem Fixer
code_block_5 = CodeBlock { 1; }
add = list_lastitem_fixer + code_block_5
isNull = Object.IsNull(object=add)
code_block_6 = CodeBlock { 1; }
scopeIf = Custom[CW.ScopeIf+](VARtest=isNull, VARtrue=code_block_6, VARfalse=add)  # package Synthesize toolkit; A (hopefully) more robust implementation of ScopeIf. Tests a single boolean and returns a value accordingly.
scopeIf_2 = Custom[CW.ScopeIf+](VARtest=n08_update_mode_false_will_auto, VARtrue=n06_form_family_number, VARfalse=scopeIf)
string_from_object = FromObject(obj=scopeIf_2)
code_block_7 = CodeBlock(a=n05_form_family_name, b=string_from_object) { a+" "+b; }
boundingBox = Element.BoundingBox(element=flatten_2)
toCuboid = BoundingBox.ToCuboid(boundingBox=boundingBox)
byGeometry = BoundingBox.ByGeometry(geom=toCuboid)
toCuboid_2 = BoundingBox.ToCuboid(boundingBox=byGeometry)
height = Cuboid.Height(cuboid=toCuboid_2)
firstItem = List.FirstItem(list=height)
unit_types = UnitTypes("Length")
displayUnitType = Custom[CW.UnitType.DisplayUnitType](VARunitType=unit_types)  # package Synthesize toolkit; Retrieves the display unit type for a given unit type.
toInternalUnit = Custom[CW.DisplayUnit.ToInternalUnit](VARval=firstItem, VARdisplayUnitType=displayUnitType.VARdisplayUnitType)  # package Synthesize toolkit; Converts a value from a given display unit to Revit's internal unit
k_rig_forms = Custom[K-Rig Forms](VARForms=flatten_2, VARGenricModelTemplatePath=smart_rft_path, VARGenricModelAdaptiveTemplatePath=smart_rft_path_2, VARIsInstance=n07_is_instance_parameters, VARFamilyName=code_block_7, VARMaterial=material, VARWantedHeight=toInternalUnit, VARIsShared=n04_is_shared)  # package Synthesize toolkit; K-Rig Forms
debug_python_no_message = Custom[Debug Python No Message]()  # package Synthesize toolkit; Debug Python
