# Dynamo graph Conceptual.Adaptive K-Super Diamond (Rhomboid) Paneling.dyn (Dynamo 2.13.1.3887)
# author: karam@aecedx.com
# packages: Synthesize toolkit 12.5.1

# group: Input
n04_sat_file_if_found_selected = StringInput("D:\Exported Loft.sat")  # "04.SAT File (If Found, Selected Faces Will Be Ignored)"; graph input
n01_select_faces = SelectFaces()  # "01.Select Faces"; nothing selected; graph input
n02_fetch_whole_body = BoolSelector(false)  # "02.Fetch Whole Body ?"; graph input
n03_faces_filter_1_vertical_faces = IntegerSlider(4, range=1..4 step 1)  # "03.Faces Filter (1 = Vertical Faces | 2 = Horizontal Up Faces | 3 = Horizontal Down Faces | 4 = All Faces)"; graph input
n12_proceed = BoolSelector(false)  # "12.Proceed ?"; graph input
n05_u_grid = DoubleInput(10)  # "05.U Grid"; graph input
n06_v_grid = DoubleInput(10)  # "06.V Grid"; graph input
n09_adaptive_quad_family_main = FamilyTypes()  # "09.Adaptive Quad Family - Main"; nothing selected; graph input
n08_points_rotation_degree = DoubleInput(0)  # "08.Points Rotation Degree"; graph input
n07_points_offset = DoubleInput(0)  # "07.Points Offset"; graph input
flip = BoolSelector(false)  # "11.Flip"; graph input
n10_adaptive_triangular_family = FamilyTypes()  # "10.Adaptive Triangular Family - Borders"; nothing selected; graph input

code_block = CodeBlock { true; }
all_surfaces_or_surface = Custom[All Surfaces or Surface Filtering](VARSurfaces=n01_select_faces, VARFetchWholeBody=n02_fetch_whole_body, VAROrienataion=n03_faces_filter_1_vertical_faces, VARBruteForceGeometryReferencesWillNotWork=code_block)  # package Synthesize toolkit; All Surfaces or Surface Filtering
k_super_diamond_paneling = Custom[K-Super Diamond Paneling](VARSATFile=n04_sat_file_if_found_selected, VARSurfaces=all_surfaces_or_surface.VARDynamoFace, VARProceed=n12_proceed, VARU=n05_u_grid, VARV=n06_v_grid, VARQuadFamilyType=n09_adaptive_quad_family_main, VARRotationDegree=n08_points_rotation_degree, VARAdaptivePointsOffset=n07_points_offset, VARFlip=flip, VARTriangularFamilyType=n10_adaptive_triangular_family)  # package Synthesize toolkit; K-Super Diamond Paneling

# group: Result
n01_accepted_quad_panels_adaptive = Watch(k_super_diamond_paneling.VARAcceptedQuadPanels)  # "01.Accepted Quad Panels/Adaptive Components Number"; graph output
n02_rejected_quad_panels_adaptive = Watch(k_super_diamond_paneling.VARRejectedQuadPanels)  # "02.Rejected Quad Panels/Adaptive Components Number"; graph output

# group: Result
n03_accepted_triangular_panels = Watch(k_super_diamond_paneling.VARAcceptedTriangularPanels)  # "03.Accepted Triangular Panels/Adaptive Components Number"; graph output
n04_rejected_triangular_panels = Watch(k_super_diamond_paneling.VARRejectedTriangularPanels)  # "04.Rejected Triangular Panels/Adaptive Components Number"; graph output

debug_python = Custom[Debug Python]()  # package Synthesize toolkit; Debug Python
