# Dynamo graph Conceptual.Adaptive K-Super Quad Paneling.dyn (Dynamo 2.13.1.3887)
# author: karam@aecedx.com
# packages: Synthesize toolkit 12.5.1

# group: Input
n04_sat_file_if_found_selected = StringInput("D:\Exported Loft.sat")  # "04.SAT File (If Found, Selected Faces Will Be Ignored)"; graph input
n01_select_faces = SelectFaces()  # "01.Select Faces"; nothing selected; graph input
n02_fetch_whole_body = BoolSelector(false)  # "02.Fetch Whole Body ?"; graph input
n03_faces_filter_1_vertical_faces = IntegerSlider(4, range=1..4 step 1)  # "03.Faces Filter (1 = Vertical Faces | 2 = Horizontal Up Faces | 3 = Horizontal Down Faces | 4 = All Faces)"; graph input
n05_u_grid = DoubleInput(10)  # "05.U Grid"; graph input
n06_v_grid = DoubleInput(10)  # "06.V Grid"; graph input
n15_placement_direction = IntegerSlider(1, range=1..4 step 1)  # "15.Placement Direction"; graph input
n16_proceed = BoolSelector(false)  # "16.Proceed ?"; graph input
n08_pattern_placement_method_x = DoubleInput(2)  # "08.Pattern Placement Method : X Points Number"; graph input
n09_pattern_placement_method_y = DoubleInput(2)  # "09.Pattern Placement Method : Y Points Number"; graph input
n10_adaptive_placement_method = BoolSelector(false)  # "10.Adaptive Placement Method : False = U Continues | True = V Continues"; graph input
n07_method_false_pattern = BoolSelector(false)  # "07.Method : False = Pattern Placement | True = Adaptive Placement"; graph input
n13_adaptive_family = FamilyTypes()  # "13.Adaptive Family"; nothing selected; graph input
n12_points_rotation_degree = DoubleInput(0)  # "12.Points Rotation Degree"; graph input
n11_points_offset = DoubleInput(0)  # "11.Points Offset"; graph input
flip = BoolSelector(false)  # "14.Flip"; graph input

code_block = CodeBlock { true; }
all_surfaces_or_surface = Custom[All Surfaces or Surface Filtering](VARSurfaces=n01_select_faces, VARFetchWholeBody=n02_fetch_whole_body, VAROrienataion=n03_faces_filter_1_vertical_faces, VARBruteForceGeometryReferencesWillNotWork=code_block)  # package Synthesize toolkit; All Surfaces or Surface Filtering
k_super_quad_master_paneling = Custom[K-Super Quad Master Paneling](VARSATFile=n04_sat_file_if_found_selected, VARSurfaces=all_surfaces_or_surface.VARDynamoFace, VARUNumber=n05_u_grid, VARVNumber=n06_v_grid, VARDirection1234=n15_placement_direction, VARProceed=n16_proceed, VARXPointsNumber=n08_pattern_placement_method_x, VARYPointsNumber=n09_pattern_placement_method_y, VARFlaseUTrueV=n10_adaptive_placement_method, VARFalsePatternTrueAdaptive=n07_method_false_pattern, VARFamilyType=n13_adaptive_family, VARRotationDegree=n12_points_rotation_degree, VARAdaptivePointsOffset=n11_points_offset, VARFlip=flip)  # package Synthesize toolkit; K-Super Quad Master Paneling

# group: Result
n01_accepted_panels_adaptive = Watch(k_super_quad_master_paneling.VARAcceptedPanels)  # "01.Accepted Panels/Adaptive Components Number"; graph output
n02_rejected_panels_adaptive = Watch(k_super_quad_master_paneling.VARRejectedPanels)  # "02.Rejected Panels/Adaptive Components Number"; graph output

debug_python = Custom[Debug Python]()  # package Synthesize toolkit; Debug Python
delete_duplicated_elements_from = Custom[Delete Duplicated Elements From List](VARElementsList=k_super_quad_master_paneling.VAROuput)  # package Synthesize toolkit; Delete Duplicated Elements From List
