# Dynamo graph Conceptual.Adaptive K-Super Remap Paneling.dyn (Dynamo 2.13.1.3887)
# author: karam@aecedx.com
# packages: Synthesize toolkit 12.5.1

# group: Input
n08_adaptive_secondary_family = FamilyTypes()  # "08.Adaptive Secondary Family"; nothing selected; graph input
n13_proceed = BoolSelector(false)  # "13.Proceed ?"; graph input
n06_points_rotation_degree = DoubleInput(0)  # "06.Points Rotation Degree"; graph input
n05_points_offset = DoubleInput(0)  # "05.Points Offset"; graph input
flip = BoolSelector(false)  # "12.Flip"; graph input
n09_adaptive_tertiary_family = FamilyTypes()  # "09.Adaptive Tertiary Family"; nothing selected; graph input
n07_adaptive_primary_family = FamilyTypes()  # "07.Adaptive Primary Family"; nothing selected; graph input
n10_adaptive_quaternary_family = FamilyTypes()  # "10.Adaptive Quaternary Family"; nothing selected; graph input
n01_select_source_face = DSFaceSelection()  # "01.Select Source Face"; nothing selected; graph input
n11_adaptive_quinary_family = FamilyTypes()  # "11.Adaptive Quinary Family"; nothing selected; graph input
n02_select_target_faces = SelectFaces()  # "02.Select Target Faces"; nothing selected; graph input
n03_sat_file_if_found_selected = StringInput("D:\Exported Loft.sat")  # "03.SAT File (If Found, Selected Target Faces Will Be Ignored)"; graph input
n04_points_tolerance = DoubleInput(0.1)  # "04.Points Tolerance"; graph input

k_super_map_revit_paneling = Custom[K-Super Map Revit Paneling - Custom](VARSecondaryType=n08_adaptive_secondary_family, VARProceed=n13_proceed, VARRotationDegree=n06_points_rotation_degree, VARAdaptivePointsOffset=n05_points_offset, VARFlip=flip, VARTertiaryType=n09_adaptive_tertiary_family, VARPrimaryType=n07_adaptive_primary_family, VARQuaternaryType=n10_adaptive_quaternary_family, VARSourceSurface=n01_select_source_face, VARQuinaryType=n11_adaptive_quinary_family, VARTargetSurfaces=n02_select_target_faces, VARSATFile=n03_sat_file_if_found_selected, VARPointsTolrance=n04_points_tolerance)  # package Synthesize toolkit; K-Super Map Revit Paneling - Custom

# group: Result
report = Watch(k_super_map_revit_paneling.VARReport)  # "01.Report"; graph output

# group: Result
n02_accepted_primary_panels = Watch(k_super_map_revit_paneling.VARAcceptedPrimaryPanels)  # "02.Accepted Primary Panels/Adaptive Components Number"; graph output
n03_rejected_primary_panels = Watch(k_super_map_revit_paneling.VARRejectedPrimaryPanels)  # "03.Rejected Primary Panels/Adaptive Components Number"; graph output

# group: Result
n04_accepted_secondary_panels = Watch(k_super_map_revit_paneling.VARAcceptedSecondaryPanels)  # "04.Accepted Secondary Panels/Adaptive Components Number"; graph output
n05_rejected_secondary_panels = Watch(k_super_map_revit_paneling.VARRejectedSecondaryPanels)  # "05.Rejected Secondary Panels/Adaptive Components Number"; graph output

# group: Result
n06_accepted_tertiary_panels = Watch(k_super_map_revit_paneling.VARAcceptedTertiaryPanels)  # "06.Accepted Tertiary Panels/Adaptive Components Number"; graph output
n07_rejected_tertiary_panels = Watch(k_super_map_revit_paneling.VARRejectedTertiaryPanels)  # "07.Rejected Tertiary Panels/Adaptive Components Number"; graph output

# group: Result
n08_accepted_quaternary_panels = Watch(k_super_map_revit_paneling.VARAcceptedQuaternaryPanels)  # "08.Accepted Quaternary Panels/Adaptive Components Number"; graph output
n09_rejected_quaternary_panels = Watch(k_super_map_revit_paneling.VARRejectedQuaternaryPanels)  # "09.Rejected Quaternary Panels/Adaptive Components Number"; graph output

# group: Result
n10_accepted_quinary_panels = Watch(k_super_map_revit_paneling.VARAcceptedQuinaryPanels)  # "10.Accepted Quinary Panels/Adaptive Components Number"; graph output
n11_rejected_quinary_panels = Watch(k_super_map_revit_paneling.VARRejectedQuinaryPanels)  # "11.Rejected Quinary Panels/Adaptive Components Number"; graph output

debug_python = Custom[Debug Python]()  # package Synthesize toolkit; Debug Python
