# Dynamo graph Conceptual.Adaptive K-Super Staggered Paneling.dyn (Dynamo 2.13.1.3887)
# author: karam@aecedx.com
# packages: Synthesize toolkit 12.5.1

# group: Input
n04_sat_file_if_found_selected = StringInput("D:\Exported Loft.sat")  # "04.SAT File (If Found, Selected Faces Will Be Ignored)"; graph input
n01_select_faces = SelectFaces()  # "01.Select Faces"; nothing selected; graph input
n02_fetch_whole_body = BoolSelector(false)  # "02.Fetch Whole Body ?"; graph input
n03_faces_filter_1_vertical_faces = IntegerSlider(4, range=1..4 step 1)  # "03.Faces Filter (1 = Vertical Faces | 2 = Horizontal Up Faces | 3 = Horizontal Down Faces | 4 = All Faces)"; graph input
n13_proceed = BoolSelector(false)  # "13.Proceed ?"; graph input
n05_u_grid = DoubleInput(10)  # "05.U Grid"; graph input
n06_v_grid = DoubleInput(10)  # "06.V Grid"; graph input
n07_rotate_staggering_direction = BoolSelector(false)  # "07.Rotate Staggering Direction ?"; graph input
n08_false_4_points_pattern_true_9 = BoolSelector(false)  # "08.False = 4 Points Pattern | True = 9 Points Pattern"; graph input
n11_adaptive_family = FamilyTypes()  # "11.Adaptive Family"; nothing selected; graph input
n10_points_rotation_degree = DoubleInput(0)  # "10.Points Rotation Degree"; graph input
n09_points_offset = DoubleInput(0)  # "09.Points Offset"; graph input
flip = BoolSelector(false)  # "12.Flip"; graph input

code_block = CodeBlock { true; }
all_surfaces_or_surface = Custom[All Surfaces or Surface Filtering](VARSurfaces=n01_select_faces, VARFetchWholeBody=n02_fetch_whole_body, VAROrienataion=n03_faces_filter_1_vertical_faces, VARBruteForceGeometryReferencesWillNotWork=code_block)  # package Synthesize toolkit; All Surfaces or Surface Filtering
k_super_staggered_paneling = Custom[K-Super Staggered Paneling](VARSATFile=n04_sat_file_if_found_selected, VARSurfaces=all_surfaces_or_surface.VARDynamoFace, VARProceed=n13_proceed, VARU=n05_u_grid, VARV=n06_v_grid, VARRotate=n07_rotate_staggering_direction, VARFalse4PointsPatternTrue9PointsPattern=n08_false_4_points_pattern_true_9, VARFamilyType=n11_adaptive_family, VARRotationDegree=n10_points_rotation_degree, VARAdaptivePointsOffset=n09_points_offset, VARFlip=flip)  # package Synthesize toolkit; K-Super Staggered Paneling

# group: Result
n01_accepted_panels_adaptive = Watch(k_super_staggered_paneling.VARAcceptedPanels)  # "01.Accepted Panels/Adaptive Components Number"; graph output
n02_rejected_panels_adaptive = Watch(k_super_staggered_paneling.VARRejectedPanels)  # "02.Rejected Panels/Adaptive Components Number"; graph output

debug_python = Custom[Debug Python]()  # package Synthesize toolkit; Debug Python
