# Dynamo graph Conceptual.Adaptive K-Super Triangle Complex Paneling.dyn (Dynamo 2.13.1.3887)
# author: karam@aecedx.com
# packages: Synthesize toolkit 12.5.1

# group: Input
n09_adaptive_triangular_family = FamilyTypes()  # "09.Adaptive Triangular Family - Laying"; nothing selected; graph input
n20_proceed = BoolSelector(false)  # "20.Proceed ?"; graph input
n08_points_rotation_degree = DoubleInput(0)  # "08.Points Rotation Degree"; graph input
n07_points_offset = DoubleInput(0)  # "07.Points Offset"; graph input
flip = BoolSelector(false)  # "19.Flip"; graph input
n13_adaptive_triangular_family = FamilyTypes()  # "13.Adaptive Triangular Family - Standing"; nothing selected; graph input
n10_adaptive_triangular_family = FamilyTypes()  # "10.Adaptive Triangular Family - Laying Corners"; nothing selected; graph input
n06_v_grid = DoubleInput(10)  # "06.V Grid"; graph input
n17_shift_all_rows = BoolSelector(false)  # "17.Shift All Rows"; graph input
n11_reverse_laying_rows = BoolSelector(false)  # "11.Reverse Laying Rows"; graph input
n15_reverse_standing_rows = BoolSelector(false)  # "15.Reverse Standing Rows"; graph input
n12_shift_laying_placement = DoubleInput(0)  # "12.Shift Laying Placement"; graph input
n16_shift_standing_placement = DoubleInput(0)  # "16.Shift Standing Placement"; graph input
n18_rotate_grid_90_degrees = BoolSelector(false)  # "18.Rotate Grid 90 Degrees ?"; graph input
n14_adaptive_triangular_family = FamilyTypes()  # "14.Adaptive Triangular Family - Standing Corners"; nothing selected; graph input
n05_u_grid = DoubleInput(10)  # "05.U Grid"; graph input
n01_select_faces = SelectFaces()  # "01.Select Faces"; nothing selected; graph input
n02_fetch_whole_body = BoolSelector(false)  # "02.Fetch Whole Body ?"; graph input
n03_faces_filter_1_vertical_faces = IntegerSlider(4, range=1..4 step 1)  # "03.Faces Filter (1 = Vertical Faces | 2 = Horizontal Up Faces | 3 = Horizontal Down Faces | 4 = All Faces)"; graph input
n04_sat_file_if_found_selected = StringInput("D:\Exported Loft.sat")  # "04.SAT File (If Found, Selected Faces Will Be Ignored)"; graph input

code_block = CodeBlock { true; }
all_surfaces_or_surface = Custom[All Surfaces or Surface Filtering](VARSurfaces=n01_select_faces, VARFetchWholeBody=n02_fetch_whole_body, VAROrienataion=n03_faces_filter_1_vertical_faces, VARBruteForceGeometryReferencesWillNotWork=code_block)  # package Synthesize toolkit; All Surfaces or Surface Filtering
k_super_triangle_complex = Custom[K-Super Triangle Complex Paneling](VARTriangleLayingType=n09_adaptive_triangular_family, VARProceed=n20_proceed, VARRotationDegree=n08_points_rotation_degree, VARAdaptivePointsOffset=n07_points_offset, VARFlip=flip, VARTriangleStandingType=n13_adaptive_triangular_family, VARTriangleLayingCornersType=n10_adaptive_triangular_family, VARV=n06_v_grid, VARshiftRows=n17_shift_all_rows, VARreverseRowsLaying=n11_reverse_laying_rows, VARreverseRowsStanding=n15_reverse_standing_rows, VARshiftPlacementRowsLaying=n12_shift_laying_placement, VARshiftPlacementRowsStanding=n16_shift_standing_placement, VARrotateGridBy90Degrees=n18_rotate_grid_90_degrees, VARTriangleStandingCornersType=n14_adaptive_triangular_family, VARU=n05_u_grid, VARSurfaces=all_surfaces_or_surface.VARDynamoFace, VARSATFile=n04_sat_file_if_found_selected)  # package Synthesize toolkit; K-Super Triangle Complex Paneling

# group: Result
n01_accepted_lying_panels = Watch(k_super_triangle_complex.VARAcceptedLayingPanels)  # "01.Accepted Lying Panels/Adaptive Components Number"; graph output
n02_rejected_lying_panels = Watch(k_super_triangle_complex.VARRejectedLayingPanels)  # "02.Rejected Lying Panels/Adaptive Components Number"; graph output

# group: Result
n03_accepted_standing_panels = Watch(k_super_triangle_complex.VARAcceptedStandingPanels)  # "03.Accepted Standing Panels/Adaptive Components Number"; graph output
n04_rejected_standing_panels = Watch(k_super_triangle_complex.VARRejectedStandingPanels)  # "04.Rejected Standing Panels/Adaptive Components Number"; graph output

# group: Result
n05_accepted_lying_corner_panels = Watch(k_super_triangle_complex.VARAcceptedLayingCornerPanels)  # "05.Accepted Lying Corner Panels/Adaptive Components Number"; graph output
n06_rejected_laying_corner_panels = Watch(k_super_triangle_complex.VARRejectedLayingCornerPanels)  # "06.Rejected Laying Corner Panels/Adaptive Components Number"; graph output

# group: Result
n07_accepted_standing_corner = Watch(k_super_triangle_complex.VARAcceptedStandingCornerPanels)  # "07.Accepted Standing Corner Panels/Adaptive Components Number"; graph output
n08_rejected_standing_corner = Watch(k_super_triangle_complex.VARRejectedStandingCornerPanels)  # "08.Rejected Standing Corner Panels/Adaptive Components Number"; graph output

debug_python = Custom[Debug Python]()  # package Synthesize toolkit; Debug Python
