# Dynamo graph Conceptual.Adaptive Points Sort Using Ref Points By All Elements of Active View.dyn "Conceptual.Adaptive Sort Adaptive Points With Reference Points By All Elements of Active View" (Dynamo 2.13.1.3887)
# author: karam@aecedx.com
# packages: Synthesize toolkit 12.5.1

debug_python_no_message = Custom[Debug Python No Message]()  # package Synthesize toolkit; Debug Python
python_all_elements_in_active = Custom[Python All Elements In Active View]()  # package Synthesize toolkit; Python All Elements In Active View

# group: Input
n01_select_sorting_reference = DSModelElementsSelection()  # "01.Select Sorting Reference Points"; nothing selected; graph input

sort_adaptive_by_reference = Custom[Sort Adaptive By Reference Points](VARAdaptiveComponents=python_all_elements_in_active, VARReferencePoints=n01_select_sorting_reference)  # package Synthesize toolkit; Sort Adaptive By Points
