# Dynamo graph Conceptual.Adaptive Renumber Adaptive Points By Family and Type.dyn (Dynamo 2.13.1.3887)
# author: karam@aecedx.com
# packages: Synthesize toolkit 12.5.1

debug_python_no_message = Custom[Debug Python No Message]()  # package Synthesize toolkit; Debug Python

# group: Input
n01_all_elements_of_family_name = BoolSelector(true)  # "01.All Elements of Family Name (All types) ?"; graph input
n02_family_names_separate_by = StringInput("Family")  # "02.Family Names (Separate By Comma , - or * To Select All Matching)"; graph input
n03_specific_type_name_separate = StringInput("Type")  # "03.Specific Type Name (Separate by Comma , )"; graph input
code_block = CodeBlock { ","; }
n04_elements_in_active_view_only = BoolSelector(false)  # "04.Elements In Active View Only ?"; graph input
n05_points_group_1_separate_by = StringInput("2,1")  # "05.Points Group 1 (Separate By Comma ,)"; graph input
n06_points_group_2_separate_by = StringInput("4,3")  # "06.Points Group 2 (Separate By Comma ,)"; graph input

family_and_type_selector = Custom[Family and Type Selector](VARAllElementsofFamilyNameAlltypes=n01_all_elements_of_family_name, VARFamilyName=n02_family_names_separate_by, VARSpecificTypeNamesSeparatebySymbol=n03_specific_type_name_separate, VARSeparationSymbol=code_block, VAROnlyInActiveView=n04_elements_in_active_view_only)  # package Synthesize toolkit; Family and Type Selector
renumber_adaptive_components = Custom[Renumber Adaptive Components](VARAdaptiveComponents=family_and_type_selector.VARElements, VARNumbersList1=n05_points_group_1_separate_by, VARNumbersList2=n06_points_group_2_separate_by)  # package Synthesize toolkit; Renumber Adaptive Components
