# Dynamo graph Conceptual.Adaptive Renumber Adaptive Points By Selection.dyn (Dynamo 2.13.1.3887)
# author: karam@aecedx.com
# packages: Synthesize toolkit 12.5.1

debug_python_no_message = Custom[Debug Python No Message]()  # package Synthesize toolkit; Debug Python

# group: Input
n01_select_adaptive_components = DSModelElementsSelection()  # "01.Select Adaptive Components"; nothing selected; graph input
n02_points_group_1_separate_by = StringInput("2,1")  # "02.Points Group 1 (Separate By Comma ,)"; graph input
n03_points_group_2_separate_by = StringInput("4,3")  # "03.Points Group 2 (Separate By Comma ,)"; graph input

renumber_adaptive_components = Custom[Renumber Adaptive Components](VARAdaptiveComponents=n01_select_adaptive_components, VARNumbersList1=n02_points_group_1_separate_by, VARNumbersList2=n03_points_group_2_separate_by)  # package Synthesize toolkit; Renumber Adaptive Components
