# Dynamo graph Conceptual.Adaptive Shift Adaptive Points By All Elements of Active View.dyn (Dynamo 2.13.1.3887)
# author: karam@aecedx.com
# packages: Synthesize toolkit 12.5.1

python_all_elements_in_active = Custom[Python All Elements In Active View]()  # package Synthesize toolkit; Python All Elements In Active View

# group: Input
n01_shift_number = DoubleInput(1)  # "01.Shift Number"; graph input
n02_clockwise = BoolSelector(false)  # "02.Clockwise ?"; graph input

shift_adaptive_components = Custom[Shift Adaptive Components](VARAdaptiveComponents=python_all_elements_in_active, VARShiftNumber=n01_shift_number, VARClockWise=n02_clockwise)  # package Synthesize toolkit; Shift Adaptive Components
debug_python_no_message = Custom[Debug Python No Message]()  # package Synthesize toolkit; Debug Python
