# Dynamo graph Conceptual.Adaptive Shift Adaptive Points By Family and Type.dyn (Dynamo 2.13.1.3887)
# author: karam@aecedx.com
# packages: Synthesize toolkit 12.5.1

# group: Input
n01_all_elements_of_family_name = BoolSelector(true)  # "01.All Elements of Family Name (All types) ?"; graph input
n02_family_names_separate_by = StringInput("Family")  # "02.Family Names (Separate By Comma , - or * To Select All Matching)"; graph input
n03_specific_type_name_separate = StringInput("Type")  # "03.Specific Type Name (Separate by Comma , )"; graph input
code_block = CodeBlock { ","; }
n04_elements_in_active_view_only = BoolSelector(false)  # "04.Elements In Active View Only ?"; graph input
n05_shift_number = DoubleInput(1)  # "05.Shift Number"; graph input
n06_clockwise = BoolSelector(false)  # "06.Clockwise ?"; graph input

family_and_type_selector = Custom[Family and Type Selector](VARAllElementsofFamilyNameAlltypes=n01_all_elements_of_family_name, VARFamilyName=n02_family_names_separate_by, VARSpecificTypeNamesSeparatebySymbol=n03_specific_type_name_separate, VARSeparationSymbol=code_block, VAROnlyInActiveView=n04_elements_in_active_view_only)  # package Synthesize toolkit; Family and Type Selector
shift_adaptive_components = Custom[Shift Adaptive Components](VARAdaptiveComponents=family_and_type_selector.VARElements, VARShiftNumber=n05_shift_number, VARClockWise=n06_clockwise)  # package Synthesize toolkit; Shift Adaptive Components
debug_python_no_message = Custom[Debug Python No Message]()  # package Synthesize toolkit; Debug Python
