# Dynamo graph Conceptual.DynaForm Complex T-Surface By Points with Thicken (BETA).dyn (Dynamo 2.13.1.3887)
# author: karam@aecedx.com
# packages: Synthesize toolkit 12.5.1

# group: Input
n02_select_points_must_have = DSModelElementsSelection()  # "02.Select Points (Must Have Alphabetical Numbered Sequence)"; nothing selected; graph input
n06_closed = BoolSelector(false)  # "06.Closed ?"; graph input
n04_max_face_valence = DoubleInput(4)  # "04.Max Face Valence"; graph input
n08_snapping_tolerance = DoubleInput(0.001)  # "08.Snapping Tolerance"; graph input
n07_crease_outer_vertices = BoolSelector(true)  # "07.Crease Outer Vertices ?"; graph input
n09_smooth_mode_in_dynamo = BoolSelector(false)  # "09.Smooth Mode (In Dynamo)"; graph input
thickness = DoubleInput(5)  # "03.Thickness"; graph input
n05_soft_edges = BoolSelector(true)  # "05.Soft Edges ?"; graph input
n10_import_to_revit = BoolSelector(false)  # "10.Import to Revit ?"; graph input

dynaform_complex_t_surface = Custom[DynaForm Complex T-Surface](VARPoints=n02_select_points_must_have, VARClosed=n06_closed)  # package Synthesize toolkit; Creates Nurbs Surface by Points in a Smart way
flatten = List.Flatten(list=dynaform_complex_t_surface)
buildFromLines = TSpline.TSplineSurface.BuildFromLines(lines=flatten, maxFaceValence=n04_max_face_valence, snappingTolerance=n08_snapping_tolerance, creaseOuterVertices=n07_crease_outer_vertices, inSmoothMode=n09_smooth_mode_in_dynamo)

# group: Connect For Importing to Revit
thicken = TSpline.TSplineSurface.Thicken(tSplineSurface=buildFromLines, distance=thickness, softEdges=n05_soft_edges)
dynaform_t_spline_import = Custom[DynaForm T-Spline Import](VARtSplineSurface=thicken, VARImporttoRevit=n10_import_to_revit)  # package Synthesize toolkit; Import to Revit

# group: Splitting -Place "Select Model Elements" node and plug into Geometry -Increate the list and plug when more copies are added from DynaForm
create = List.Create(item0=dynaform_t_spline_import.VARGeometry)
flatten_2 = List.Flatten(list=create)
dyna_split = Custom[Dyna Split](VARGeometry=flatten_2)  # package Synthesize toolkit; Dynamo Split Node; unwired: VARGeometry_2

note = StringInput("-You should open the Script and Run in Automatic mode for more flexibility.")  # "01.Note"; graph input
debug_python = Custom[Debug Python]()  # package Synthesize toolkit; Debug Python
