# Dynamo graph Conceptual.DynaLine By Add Profile.dyn (Dynamo 2.13.1.3887)
# author: karam@aecedx.com
# packages: Synthesize toolkit 12.5.1

# group: Input
n07_detail_line_false_model_line = BoolSelector(true)  # "07.Detail Line = False | Model Line = True"; graph input
n05_number_of_control_points = DoubleInput(15)  # "05.Number of Control Points Desired"; graph input
n04_with_points_conceptual = BoolSelector(false)  # "04.With Points ? (Conceptual Environment Only)"; graph input
n02_flatten_to_nearest_level = BoolSelector(false)  # "02.Flatten to Nearest Level ?"; graph input
n03_exact_same_curve_ignores = BoolSelector(false)  # "03.Exact Same Curve (Ignores Number of Control Points Desired) Useful for Converting Into Smart Lines, However it set to False, the Lines will try to Join"; graph input
n06_split_normalize_factor_exact = DoubleSlider(0.5, range=0..1 step 0.01)  # "06.Split Normalize Factor (Exact Same Line Must be Disabled, Works for Closed Loops Only)"; graph input
n01_flase_u_profile_true_v = BoolSelector(false)  # "01.Flase = U Profile | True = V Profile"; graph input

selectFaces = Custom[SP.SelectFaces+]()  # package Synthesize toolkit; Select multiple faces from inside the Revit UI. Be sure to press "Finish" once done. Unlike the built-in node, face references of instances will be added sucessfully and you'l get the pick points. You can use a Boolean toggle to refresh your selection.
code_block = CodeBlock { 0; 1; }
scopeIf = Custom[CW.ScopeIf+](VARtest=n01_flase_u_profile_true_v, VARtrue=code_block.out1, VARfalse=code_block.out0)  # package Synthesize toolkit; A (hopefully) more robust implementation of ScopeIf. Tests a single boolean and returns a value accordingly.
UVParameterAtPoint = Surface.UVParameterAtPoint(surface=selectFaces.VARfaces, point=selectFaces.VARpickPoints)
U = UV.U(uV=UVParameterAtPoint)
V = UV.V(uV=UVParameterAtPoint)
scopeIf_2 = Custom[CW.ScopeIf+](VARtest=n01_flase_u_profile_true_v, VARtrue=U, VARfalse=V)
firstItem = List.FirstItem(list=scopeIf_2)
getIsoline = Surface.GetIsoline(surface=selectFaces.VARfaces, isoDirection=scopeIf, parameter=firstItem)
flatten = List.Flatten(list=getIsoline)
generate_lines_helper_for_smart = Custom[Generate Lines (Helper for Smart Arcs Detection)](VARCurves=flatten, VARExactSameEdgeIgnoresNumberofControlPointsDesiredUsefulforConvertingIntoSmartLinesHoweveritsettoTruetheLineswilltrytoJoin=n03_exact_same_curve_ignores, VARWithPointsConceptualEnvironmentOnly=n04_with_points_conceptual)  # package Synthesize toolkit; Generate Lines (Helper for Smart Lines)
generate_lines_smart_with_auto = Custom[Generate Lines (Smart with Auto compatibility with Revit)](VARNumberofControlPointsPerLine=n05_number_of_control_points, VARWithPoints=n04_with_points_conceptual, VARFlattentoNearestLevel=n02_flatten_to_nearest_level, VARExactSameLineIgnoresNumberofControlPointsDesiredUsefulforConvertingIntoSmartLines=n03_exact_same_curve_ignores, VARSplitNormalizeFactorExactSameLineMustbeFasleWorksforClosedLoopsOnly=n06_split_normalize_factor_exact, VARCurves=generate_lines_helper_for_smart.VARCurves)  # package Synthesize toolkit; Generate Lines (Smart with Auto compatibility with Revit)
create = List.Create(item0=generate_lines_smart_with_auto.VARModelCurves, item1=generate_lines_helper_for_smart.VARModelCurves)
model_line_or_detail_line_from = Custom[Model Line or Detail Line From (Model Line)](VARDetailLine=n07_detail_line_false_model_line, VARModelCurve=create)  # package Synthesize toolkit; Model Line or Detail Line From (Model Line)
debug_python = Custom[Debug Python]()  # package Synthesize toolkit; Debug Python
