# Dynamo graph Conceptual.DynaLine By Points.dyn (Dynamo 2.13.1.3887)
# author: karam@aecedx.com
# packages: Synthesize toolkit 12.5.1

# group: Input
n03_spline_through_points = BoolSelector(true)  # "03.Spline Through Points ?"; graph input
n05_is_reference = BoolSelector(false)  # "05.Is Reference ?"; graph input
n04_divisions_works_if_spline = DoubleInput(15)  # "04.Divisions (Works if Spline Through Points is Off)"; graph input
n01_select_points_better_be = DSModelElementsSelection()  # "01.Select Points (Better Be Numbered)"; nothing selected; graph input
n02_pairs = BoolSelector(false)  # "02.Pairs ?"; graph input

dynaLine = Custom[DynaLine](VARSplineThroughPoints=n03_spline_through_points, VARIsReference=n05_is_reference, VARDivisions=n04_divisions_works_if_spline, VARPoints=n01_select_points_better_be, VARPairs=n02_pairs)  # package Synthesize toolkit; Create Dynamo Lines
debug_python = Custom[Debug Python]()  # package Synthesize toolkit; Debug Python
