# Dynamo graph Conceptual.DynaLine By Spline By Points.dyn (Dynamo 2.13.1.3887)
# author: karam@aecedx.com
# packages: Synthesize toolkit 12.5.1

# group: Input
n01_select_splines_by_points = DSModelElementsSelection()  # "01.Select Splines By Points"; nothing selected; graph input
n02_distance_between_result = DoubleInput(2)  # "02.Distance Between Result Points"; graph input
n03_is_reference_line = BoolSelector(true)  # "03.Is Reference Line ?"; graph input

code_block = CodeBlock { "CurveByPoints"; }
byClassName = Custom[SP.Filter.ByClassName](VARobject=n01_select_splines_by_points, VARclassName=code_block)  # package Synthesize toolkit; Filters a list of objects by the object's class name. Note that Dynamo elements belong to different classes than their Revit counterparts. Use the Object.Class node to check an object's class.
python_script = Python(IN[0]=byClassName.VARin)  # IronPython2
# ---------- python_script.python (60 lines) ----------
# Enable Python support and load DesignScript library
# IMPORTANT : ALL DYNAMO DESIGN SCRIPT NODES ARE AS (dg)
import clr
clr.AddReference('ProtoGeometry')
from Autodesk.DesignScript import Geometry as dg

# EXTENSION Enable ToDSType
clr.AddReference('RevitNodes')
import Revit
clr.ImportExtensions(Revit.Elements)

# Enable Revit Elements
from Revit.Elements import *

# EXTENSION Enable Geometry Conversion Methods
clr.ImportExtensions(Revit.GeometryConversion)

# Enable Revit API
clr.AddReference('RevitAPI')
from Autodesk.Revit.DB import *

# Enable DocumentManager and TransactionManager
clr.AddReference('RevitServices')
from RevitServices.Persistence import DocumentManager
from RevitServices.Transactions import TransactionManager

# Enable ICollection List Translate
clr.AddReference("System")
import System.Collections.Generic
from System.Collections.Generic import List

dataEnteringNode = IN
# Use UnwrapElement(IN[0]) When Translating From Dynamo to Revit
curves=UnwrapElement(IN[0])


# Choose The Current Document
doc = DocumentManager.Instance.CurrentDBDocument
uidoc = DocumentManager.Instance.CurrentUIApplication.ActiveUIDocument
uiapp = DocumentManager.Instance.CurrentUIApplication
app = uiapp.Application

# Create Empty List
result = []

# Start a Transaction with Current Document (doc)
TransactionManager.Instance.EnsureInTransaction(doc)
for each in curves:
	points = each.GetPoints()
	tmplist = []
	for p in points:
		tmplist.append(p.ToDSType(True))
	result.append(tmplist)

# End the Transaction with Current Document ()
TransactionManager.Instance.TransactionTaskDone()


# Assign your output to the OUT variable.
OUT = result
# ----------------------------------------
point = ReferencePoint.Point(referencePoint=python_script)
byControlPoints = NurbsCurve.ByControlPoints(points=point)
code_block_2 = CodeBlock { 0; 1; }
length = Curve.Length(curve=byControlPoints)
div = length / n02_distance_between_result
ceiling = Math.Ceiling(number=div)
sequence = Sequence(start=code_block_2.out0, amount=ceiling, step=code_block_2.out1, lacing=Longest)
remapRange = Math.RemapRange(numbers=sequence, newMin=code_block_2.out0, newMax=code_block_2.out1)
pointAtParameter = Curve.PointAtParameter(curve=byControlPoints, param=remapRange)
byPoint = ReferencePoint.ByPoint(pt=pointAtParameter)
byReferencePoints = CurveByPoints.ByReferencePoints(points=byPoint, isReferenceLine=n03_is_reference_line)
debug_python = Custom[Debug Python]()  # package Synthesize toolkit; Debug Python
