# Dynamo graph Conceptual.DynaLine By UV Grid Points.dyn (Dynamo 2.13.1.3887)
# author: karam@aecedx.com
# packages: Synthesize toolkit 12.5.1

# group: Input
n07_create_selection_filter = BoolSelector(true)  # "07.Create Selection Filter ?"; graph input
n08_filter_name_to_create = StringInput("Dynamo Generated Profiles")  # "08.Filter Name to Create"; graph input
n09_overwrite_existing_filter = BoolSelector(false)  # "09.Overwrite Existing Filter ? (False for Adding Elements)"; graph input
n04_spline_through_points_hosted = BoolSelector(true)  # "04.Spline Through Points ? (Hosted, Also Switching in Automatic Mode Will Delete Points)"; graph input
n06_is_reference = BoolSelector(false)  # "06.Is Reference ?"; graph input
n05_divisions_works_if_spline = DoubleInput(3)  # "05.Divisions (Works if Spline Through Points is Off)"; graph input
n03_flip_profiles_direction = BoolSelector(false)  # "03.Flip Profiles Direction ?"; graph input
n01_select_uv_points = DSModelElementsSelection()  # "01.Select UV Points"; nothing selected; graph input
n02_pairs = BoolSelector(false)  # "02.Pairs ?"; graph input

flatten = List.Flatten(list=n01_select_uv_points)
uv_grid_lines_connect = Custom[UV Grid Lines Connect](VARPoints=flatten)  # package Synthesize toolkit; UV Grid Lines Connect
transpose = List.Transpose(lists=uv_grid_lines_connect.VARGroupedReferencePoints)
code_block = CodeBlock { null; false; }
scopeIf = Custom[CW.ScopeIf+](VARtest=n03_flip_profiles_direction, VARtrue=transpose, VARfalse=code_block.out0)  # package Synthesize toolkit; A (hopefully) more robust implementation of ScopeIf. Tests a single boolean and returns a value accordingly.
scopeIf_2 = Custom[CW.ScopeIf+](VARtest=n03_flip_profiles_direction, VARtrue=code_block.out0, VARfalse=uv_grid_lines_connect.VARGroupedReferencePoints)
create = List.Create(item0=scopeIf, item1=scopeIf_2)
clean = List.Clean(list=create, preserveIndices=code_block.out1)
dynaline_from_uv_grid = Custom[DynaLine From UV Grid](VARSplineThroughPoints=n04_spline_through_points_hosted, VARIsReference=n06_is_reference, VARDivisions=n05_divisions_works_if_spline, VARPoints=clean, VARPairs=n02_pairs)  # package Synthesize toolkit; Create Dynamo Lines From UV Grid
generate_selection_filter = Custom[Generate Selection Filter](VARCreateSelectionFilter=n07_create_selection_filter, VARFilterNametoCreate=n08_filter_name_to_create, VAROverwriteExistingFilter=n09_overwrite_existing_filter, VARElements=dynaline_from_uv_grid.VARCurveByPoints)  # package Synthesize toolkit; Generate Selection FIlter
debug_python = Custom[Debug Python]()  # package Synthesize toolkit; Debug Python
