# Dynamo graph Conceptual.DynaPoint Auto Name Sequence By Sorting Curve.dyn (Dynamo 2.13.1.3887)
# author: karam@aecedx.com
# packages: Synthesize toolkit 12.5.1

# group: Input
n04_automatic_points_number = BoolSelector(true)  # "04.Automatic Points Number Detection ? (False for Custom)"; graph input
n05_custom_number_sequence_start = DoubleInput(1)  # "05.Custom Number Sequence Start"; graph input
n06_by_build_order_by_sorting = BoolSelector(false)  # "06.By Build Order ? (By Sorting Curve Order if Set to False)"; graph input
n01_select_points = DSModelElementsSelection()  # "01.Select Points"; nothing selected; graph input
n02_select_sorting_curve = DSModelElementSelection()  # "02.Select Sorting Curve"; nothing selected; graph input
n03_alphabetical_letter_sequence = StringInput("A")  # "03.Alphabetical Letter Sequence Start (Can be Empty) ?"; graph input

code_block = CodeBlock { "[0-9]+"; }
element_types = ElementTypes("ReferencePoint")
all_elements_of_type = ElementsOfType(element_type=element_types)
code_block_2 = CodeBlock { "Name"; }
getParameterValueByName = Element.GetParameterValueByName(element=all_elements_of_type, parameterName=code_block_2)
code_block_3 = CodeBlock { ""; }
eq = getParameterValueByName == code_block_3
filterByBoolMask = List.FilterByBoolMask(list=getParameterValueByName, mask=eq)
findRegularExpression = Custom[CW.String.FindRegularExpression](VARRegEx=code_block, VARstr=filterByBoolMask.out)  # package Synthesize toolkit; Returns all occurences of a regular expression within a string (or list of strings). The syntax for regular expressions is explained at http://ironpython-test.readthedocs.org/en/latest/howto/regex.html
flatten = List.Flatten(list=findRegularExpression)
toNumber = String.ToNumber(string=flatten)
uniqueItems = List.UniqueItems(list=toNumber)
sort = List.Sort(list=uniqueItems)
list_lastitem_fixer = Custom[List.LastItem Fixer](VARlist=sort)  # package Synthesize toolkit; List.LastItem Fixer
code_block_4 = CodeBlock { 1; }
add = list_lastitem_fixer + code_block_4
isNull = Object.IsNull(object=add)
code_block_5 = CodeBlock { 1; }
scopeIf = Custom[CW.ScopeIf+](VARtest=isNull, VARtrue=code_block_5, VARfalse=add)  # package Synthesize toolkit; A (hopefully) more robust implementation of ScopeIf. Tests a single boolean and returns a value accordingly.
scopeIf_2 = Custom[CW.ScopeIf+](VARtest=n04_automatic_points_number, VARtrue=scopeIf, VARfalse=n05_custom_number_sequence_start)
code_block_6 = CodeBlock { "Reference Point"; }
filterByString = Custom[ST.List.FilterByString](VARlist=n01_select_points, VARString=code_block_6)  # package Synthesize toolkit; Filter a list by a string match
point = ReferencePoint.Point(referencePoint=filterByString.VARMatch)
curves = Element.Curves(element=n02_select_sorting_curve)
sort_geometry_by_guides = Custom[Sort Geometry By Guides](VARGeometries=point, VARGuides=curves)  # package Synthesize toolkit; Sort Loft Profiles According to Guide
as_list_sortbykey = Custom[AS.[&] List.SortByKey](VARlist=filterByString.VARMatch, VARkeys=sort_geometry_by_guides.VARKeys)  # package Synthesize toolkit; Sort a list (or lists) according to the order specified by the key list.
scopeIf_3 = Custom[CW.ScopeIf+](VARtest=n06_by_build_order_by_sorting, VARtrue=filterByString.VARMatch, VARfalse=as_list_sortbykey.VARsortedlist)
count = List.Count(list=scopeIf_3)
code_block_7 = CodeBlock { 1; }
sequence = Sequence(start=scopeIf_2, amount=count, step=code_block_7, lacing=Longest)
string_from_object = FromObject(obj=sequence)
code_block_8 = CodeBlock { ""; }
join = String.Join(separator=code_block_8, string0=n03_alphabetical_letter_sequence)  # unwired: string1
map = List.Map(list=string_from_object, f_x=join)
trimWhitespace = String.TrimWhitespace(string=map)
code_block_9 = CodeBlock { "Name"; }
code_block_10 = CodeBlock { 0.0001; }
sequence_2 = Sequence(start=code_block_10, amount=count, step=code_block_10, lacing=Longest)
string_from_object_2 = FromObject(obj=sequence_2)
setParameterByName = Element.SetParameterByName(element=scopeIf_3, parameterName=code_block_9, value=string_from_object_2)
passthrough = Custom[CW.Passthrough](VARpassThrough=trimWhitespace, VARwaitFor=setParameterByName)  # package Synthesize toolkit; Forces a sequential order of execution. The node wired into the output of the Passthrough node will be executed *after* the node wired into the waitFor input (e.g. important for some Revit operations). The value of the passThrough input will be passed on to the node wired into the output port of the Passthrough node.
lastItem = List.LastItem(list=passthrough)
passthrough_2 = Custom[CW.Passthrough](VARpassThrough=scopeIf_3, VARwaitFor=setParameterByName)
passthrough_3 = Custom[CW.Passthrough](VARpassThrough=code_block_9, VARwaitFor=setParameterByName)
setParameterByName_2 = Element.SetParameterByName(element=passthrough_2, parameterName=passthrough_3, value=passthrough)
count_2 = List.Count(list=setParameterByName_2)

# group: Report
n01_last_point_name = Watch(lastItem)  # "01.Last Point Name"; graph output
n02_number_of_points_re_named = Watch(count_2)  # "02.Number of points Re-named"; graph output

debug_python = Custom[Debug Python]()  # package Synthesize toolkit; Debug Python
