# Dynamo graph Conceptual.DynaPoint Duplicate On Other Points.dyn (Dynamo 2.13.1.3887)
# author: karam@aecedx.com
# packages: Synthesize toolkit 12.5.1

# group: Input
n12_name_points_by_sequence = BoolSelector(false)  # "12.Name Points By Sequence"; graph input
n01_select_points = DSModelElementsSelection()  # "01.Select Points"; nothing selected; graph input
n03_base_plane_1_xy_as_base_2_yz = IntegerSlider(1, range=1..3 step 1)  # "03.Base Plane: 1 = XY as Base | 2 = YZ as Base | 3 = XZ as Base"; graph input
n02_points_offset_in_meters = DoubleInput(2)  # "02.Points Offset (In Meters)"; graph input
n05_create_offset_parameter = BoolSelector(true)  # "05.Create Offset Parameter ?"; graph input
n06_offset_parameter_name = StringInput("Offset")  # "06.Offset Parameter: Name"; graph input
n08_offset_parameter_group_pg = BuiltInParameterGroup("PG_GEOMETRY")  # "08.Offset Parameter: Group (PG_Geometry is Dimensions)"; graph input
n07_offset_parameter_is_instance = BoolSelector(false)  # "07.Offset Parameter: Is Instance ?"; graph input
n09_connect_lines_points_together = BoolSelector(false)  # "09.Connect Lines: Points Together ?"; graph input
n11_lines_is_reference_line = BoolSelector(true)  # "11.Lines: Is Reference Line ?"; graph input
n04_force_xy_as_base = BoolSelector(false)  # "04.Force XY as Base"; graph input
n10_connect_lines_points_with = BoolSelector(false)  # "10.Connect Lines: Points With Base Points ?"; graph input
n14_automatic_points_number = BoolSelector(true)  # "14.Automatic Points Number Detection ? (False for Custom)"; graph input
n15_custom_number_sequence_start = DoubleInput(1)  # "15.Custom Number Sequence Start"; graph input
n13_alphabetical_letter_sequence = StringInput("B")  # "13.Alphabetical Letter Sequence Start (Can be Empty) ?"; graph input

code_block = CodeBlock { "Reference Point"; }
filterByString = Custom[ST.List.FilterByString](VARlist=n01_select_points, VARString=code_block)  # package Synthesize toolkit; Filter a list by a string match
turnIntoList = Custom[CW.TurnIntoList](VARunknownItem=filterByString.VARMatch)  # package Synthesize toolkit; Turns an element (or a nested list) into a flat list
convert_between_units = DynamoConvert(n02_points_offset_in_meters, MeasurementType="Length", FromConversion="Meters", ToConversion="Feet")
translate_builtin_parameter = Custom[Translate BuiltIn Parameter Group](VARBuiltInParameterGroupString=n08_offset_parameter_group_pg)  # package Synthesize toolkit; Translate BuiltIn Parameter Group
python_script = Python(IN[0]=turnIntoList, IN[1]=n03_base_plane_1_xy_as_base_2_yz, IN[2]=convert_between_units, IN[3]=n05_create_offset_parameter, IN[4]=n06_offset_parameter_name, IN[5]=translate_builtin_parameter, IN[6]=n07_offset_parameter_is_instance, IN[7]=n09_connect_lines_points_together, IN[8]=n11_lines_is_reference_line, IN[9]=n04_force_xy_as_base, IN[10]=n10_connect_lines_points_with)  # IronPython2
# ---------- python_script.python (150 lines) ----------
import clr
clr.AddReference('RevitAPI')
from Autodesk.Revit.DB import*
clr.AddReference('RevitServices')
from RevitServices.Persistence import DocumentManager
from RevitServices.Transactions import TransactionManager
from Autodesk.Revit.Creation.FamilyItemFactory import NewReferencePoint
clr.AddReference('RevitNodes')
import Revit
clr.ImportExtensions(Revit.GeometryConversion)

doc = DocumentManager.Instance.CurrentDBDocument
app = doc.Application

def getfamtype(famdoc,famtypename = None):
	alltypes = famdoc.FamilyManager.Types
	if len(list(alltypes)) == 1 or famtypename == None:
		famtype = famdoc.FamilyManager.CurrentType
	elif len(list(alltypes)) == 0 or famtypename == None:
		famtype = famdoc.FamilyManager.NewType(famtypename)
		famdoc.FamilyManager.CurrentType = famtype
	else:
		for t in alltypes:
			if t.Name == famtypename:
				famdoc.FamilyManager.CurrentType = t
				famtype = t
				break
	return famtype

def newrefpt(doc,refpt,option):
	if option == 1:
		r = refpt.GetCoordinatePlaneReferenceXY()
		re = app.Create.NewPointOnPlane(r,UV(),UV(),0)
		pts = doc.FamilyCreate.NewReferencePoint(re)
	elif option == 2:
		r = refpt.GetCoordinatePlaneReferenceYZ()
		re = app.Create.NewPointOnPlane(r,UV(),UV(),0)
		pts = doc.FamilyCreate.NewReferencePoint(re)
	elif option == 3:	
		r = refpt.GetCoordinatePlaneReferenceXZ()
		re = app.Create.NewPointOnPlane(r,UV(),UV(),0)
		pts = doc.FamilyCreate.NewReferencePoint(re)
	else:
		pts = "Please Choose Proper Option : 1, 2 or 3"
	return pts

def isgood(opt,pt,offset):
	h1 = opt.GetCoordinateSystem().Origin.ToPoint().Z
	h2 = pt.Z
	if offset > 0 and (h1 > h2 or h1 == h2):
		return False
	if offset < 0 and (h2 > h1 or h1 == h2):
		return False
	return True

refpts = UnwrapElement(IN[0])
option = IN[1]
offset = IN[2]
createoffparam = IN[3]
defnametoadd = IN[4]
pgroup = UnwrapElement(IN[5])
ismatinstance = IN[6]
connectlines = IN[7]
isrefline = IN[8]
forceXY = IN[9]
connectwithbase = IN[10]

if int(DocumentManager.Instance.CurrentUIApplication.Application.VersionNumber) < 2021:
	anglefactor = UnitUtils.ConvertToInternalUnits(1,doc.GetUnits().GetFormatOptions(UnitType.UT_Angle).DisplayUnits)
else:
	anglefactor = UnitUtils.ConvertToInternalUnits(1,doc.GetUnits().GetFormatOptions(SpecTypeId.Angle).GetUnitTypeId())

pts = []
TransactionManager.Instance.EnsureInTransaction(doc)
getfamtype(doc,doc.Title)

baselines = []
pts = []
for p in refpts:
	if forceXY:
		safe = False
		opt = 1
		while safe == False:
			pnew = newrefpt(doc,p,opt)
			pnew.LookupParameter("Offset").Set(offset)
			doc.Regenerate()
			pt = pnew.GetCoordinateSystem().Origin.ToPoint()
			if isgood(p,pt,offset) == False:
				doc.Delete(pnew.Id)
				opt += 1
			else:
				safe = True
				break
			if opt > 3:
				opt = 1
				oldangle = p.LookupParameter("Rotation Angle").AsDouble()
				newangle = (90 * anglefactor) + oldangle
				p.LookupParameter("Rotation Angle").Set(newangle)
		pts.append(pnew)
	else:
		pnew = newrefpt(doc,p,option)
		pnew.LookupParameter("Offset").Set(offset)
		pts.append(pnew)
	if connectwithbase:
		doc.Regenerate()
		baselinelist = ReferencePointArray()
		baselinelist.Append(p)
		baselinelist.Append(pnew)
		baseline = doc.FamilyCreate.NewCurveByPoints(baselinelist)
		if isrefline:
			baseline.LookupParameter("Is Reference Line").Set(1)
		baselines.append(baseline)

if createoffparam:
	try:
		famnewpar = doc.FamilyManager.AddParameter(defnametoadd,pgroup,ParameterType.Length,ismatinstance)
	except:
		existedparams = doc.FamilyManager.GetParameters()
		for existedp in existedparams:
			if existedp.Definition.Name == defnametoadd:
				famnewpar = existedp
				if (ismatinstance and existedp.IsInstance) or (ismatinstance == False and existedp.IsInstance == False):
					break
				elif ismatinstance:
					doc.FamilyManager.MakeInstance(famnewpar)
				else:
					doc.FamilyManager.MakeType(famnewpar)
				break
count = 0
lines = []
for p in pts:
	if connectlines:
		linelist = ReferencePointArray()
		linelist.Append(pts[count])
		linelist.Append(pts[count-1])
		line = doc.FamilyCreate.NewCurveByPoints(linelist)
		if isrefline:
			line.LookupParameter("Is Reference Line").Set(1)
		lines.append(line)
	param = p.LookupParameter("Offset")
	if createoffparam == False:
		param.Set(offset)
	count += 1
	if createoffparam:
		doc.FamilyManager.AssociateElementParameterToFamilyParameter(param,famnewpar)
if createoffparam:
	doc.FamilyManager.Set(famnewpar,offset)
TransactionManager.Instance.TransactionTaskDone()

OUT = pts,lines,baselines
# ----------------------------------------
code_block_2 = CodeBlock(a=python_script) { a[0]; }
code_block_3 = CodeBlock { null; }
scopeIf = Custom[CW.ScopeIf+](VARtest=n12_name_points_by_sequence, VARtrue=code_block_2, VARfalse=code_block_3)  # package Synthesize toolkit; A (hopefully) more robust implementation of ScopeIf. Tests a single boolean and returns a value accordingly.
turnIntoList_2 = Custom[CW.TurnIntoList](VARunknownItem=scopeIf)
code_block_4 = CodeBlock { false; }
clean = List.Clean(list=turnIntoList_2, preserveIndices=code_block_4)
flatten = List.Flatten(list=clean)
code_block_5 = CodeBlock { "Name"; ""; }
scopeIf_2 = Custom[CW.ScopeIf+](VARtest=n12_name_points_by_sequence, VARtrue=code_block_5.out0, VARfalse=code_block_3)
turnIntoList_3 = Custom[CW.TurnIntoList](VARunknownItem=scopeIf_2)
clean_2 = List.Clean(list=turnIntoList_3, preserveIndices=code_block_4)
flatten_2 = List.Flatten(list=clean_2)
code_block_6 = CodeBlock { 0.0001; }
count = List.Count(list=scopeIf)
sequence = Sequence(start=code_block_6, amount=count, step=code_block_6, lacing=Longest)
string_from_object = FromObject(obj=sequence)
scopeIf_3 = Custom[CW.ScopeIf+](VARtest=n12_name_points_by_sequence, VARtrue=string_from_object, VARfalse=code_block_3)
clean_3 = List.Clean(list=scopeIf_3, preserveIndices=code_block_4)
setParameterByName = Element.SetParameterByName(element=flatten, parameterName=flatten_2, value=clean_3, lacing=Longest)
passthrough = Custom[CW.Passthrough](VARpassThrough=scopeIf, VARwaitFor=setParameterByName)  # package Synthesize toolkit; Forces a sequential order of execution. The node wired into the output of the Passthrough node will be executed *after* the node wired into the waitFor input (e.g. important for some Revit operations). The value of the passThrough input will be passed on to the node wired into the output port of the Passthrough node.
turnIntoList_4 = Custom[CW.TurnIntoList](VARunknownItem=passthrough)
clean_4 = List.Clean(list=turnIntoList_4, preserveIndices=code_block_4)
passthrough_2 = Custom[CW.Passthrough](VARpassThrough=code_block_5.out0, VARwaitFor=setParameterByName)
code_block_7 = CodeBlock { "[0-9]+"; }
element_types = ElementTypes("ReferencePoint")
all_elements_of_type = ElementsOfType(element_type=element_types)
code_block_8 = CodeBlock { "Name"; }
getParameterValueByName = Element.GetParameterValueByName(element=all_elements_of_type, parameterName=code_block_8)
code_block_9 = CodeBlock { ""; }
eq = getParameterValueByName == code_block_9
filterByBoolMask = List.FilterByBoolMask(list=getParameterValueByName, mask=eq)
findRegularExpression = Custom[CW.String.FindRegularExpression](VARRegEx=code_block_7, VARstr=filterByBoolMask.out)  # package Synthesize toolkit; Returns all occurences of a regular expression within a string (or list of strings). The syntax for regular expressions is explained at http://ironpython-test.readthedocs.org/en/latest/howto/regex.html
flatten_3 = List.Flatten(list=findRegularExpression)
toNumber = String.ToNumber(string=flatten_3)
uniqueItems = List.UniqueItems(list=toNumber)
sort = List.Sort(list=uniqueItems)
list_lastitem_fixer = Custom[List.LastItem Fixer](VARlist=sort)  # package Synthesize toolkit; List.LastItem Fixer
code_block_10 = CodeBlock { 1; }
add = list_lastitem_fixer + code_block_10
isNull = Object.IsNull(object=add)
code_block_11 = CodeBlock { 1; }
scopeIf_4 = Custom[CW.ScopeIf+](VARtest=isNull, VARtrue=code_block_11, VARfalse=add)
scopeIf_5 = Custom[CW.ScopeIf+](VARtest=n14_automatic_points_number, VARtrue=scopeIf_4, VARfalse=n15_custom_number_sequence_start)
code_block_12 = CodeBlock { 1; }
sequence_2 = Sequence(start=scopeIf_5, amount=count, step=code_block_12, lacing=Longest)
string_from_object_2 = FromObject(obj=sequence_2)
join = String.Join(separator=code_block_5.out1, string0=n13_alphabetical_letter_sequence)  # unwired: string1
map = List.Map(list=string_from_object_2, f_x=join)
trimWhitespace = String.TrimWhitespace()  # unwired: string
map_2 = List.Map(list=map, f_x=trimWhitespace)
passthrough_3 = Custom[CW.Passthrough](VARpassThrough=map_2, VARwaitFor=setParameterByName)
turnIntoList_5 = Custom[CW.TurnIntoList](VARunknownItem=passthrough_3)
clean_5 = List.Clean(list=turnIntoList_5, preserveIndices=code_block_4)
setParameterByName_2 = Element.SetParameterByName(element=clean_4, parameterName=passthrough_2, value=clean_5)
count_2 = List.Count(list=setParameterByName_2)
count_3 = List.Count(list=code_block_2)
list_lastitem_fixer_2 = Custom[List.LastItem Fixer](VARlist=passthrough_3)
code_block_13 = CodeBlock { "Inactive"; }
scopeIf_6 = Custom[CW.ScopeIf+](VARtest=n12_name_points_by_sequence, VARtrue=list_lastitem_fixer_2, VARfalse=code_block_13)

# group: Report
n01_number_of_points_created = Watch(count_3)  # "01.Number of Points Created"; graph output
n02_last_point_name = Watch(scopeIf_6)  # "02.Last Point Name"; graph output

debug_python_no_message = Custom[Debug Python No Message]()  # package Synthesize toolkit; Debug Python
