# Dynamo graph Conceptual.DynaPoint Fix Reference Point Orientation.dyn (Dynamo 2.13.1.3887)
# author: karam@aecedx.com
# packages: Synthesize toolkit 12.5.1

k_adaptive_component_by = Custom[K-Adaptive Component By Coordinate System]()  # package Synthesize toolkit; A Better Adaptive Component Placement Method Using Coordinate System; unwired: VARCoordinateSystem, VARFamilyType, VARFlip

# group: Input
n04_points_offset = DoubleInput(0)  # "04.Points Offset"; graph input
n01_select_reference_points = DSModelElementsSelection()  # "01.Select Reference Points"; nothing selected; graph input
n02_select_face = DSFaceSelection()  # "02.Select Face"; nothing selected; graph input
n05_flip = BoolSelector(false)  # "05.Flip ?"; graph input
n03_rotation_degree = DoubleInput(0)  # "03.Rotation Degree"; graph input

code_block = CodeBlock { "Reference Point"; }
filterByString = Custom[ST.List.FilterByString](VARlist=n01_select_reference_points, VARString=code_block)  # package Synthesize toolkit; Filter a list by a string match
point = ReferencePoint.Point(referencePoint=filterByString.VARMatch)
coordinate_system_adaptive = Custom[Coordinate System Adaptive Surface Prepare](VARAdaptivePointsOffset=n04_points_offset, VARPointsLists=point, VARSurfaces=n02_select_face, VARFlip=n05_flip, lacing=Longest)  # package Synthesize toolkit; Coordinate System Adaptive Surface Prepare
coordinate_sytem_rotate_by_z = Custom[Coordinate Sytem Rotate By Z Axis](VARcoordinateSystem=coordinate_system_adaptive, VARdegrees=n03_rotation_degree)  # package Synthesize toolkit; Coordinate Sytem Rotate By Z Axis
reference_point_orientation_fix = Custom[Reference Point Orientation Fix By Coordinate System](VARCoordinateSystem=coordinate_sytem_rotate_by_z, VARReferencePoint=filterByString.VARMatch)  # package Synthesize toolkit; Reference Point By Coordinate System
debug_python = Custom[Debug Python]()  # package Synthesize toolkit; Debug Python
