# Dynamo graph Conceptual.DynaPoint Host By Divided Paths On Curves.dyn (Dynamo 2.13.1.3887)
# author: karam@aecedx.com
# packages: Synthesize toolkit 12.5.1

# group: Input
n02_name_points = BoolSelector(true)  # "02.Name Points ?"; graph input
n03_numbering_sequence_false = BoolSelector(false)  # "03.Numbering Sequence = False | Alphabatical Naming = True"; graph input
n04_automatic_points_number = BoolSelector(true)  # "04.Automatic Points Number Detection ? (False for Custom)"; graph input
n05_custom_point_name_numbering = DoubleInput(1)  # "05.Custom Point Name Numbering Sequence Start"; graph input
n01_select_divided_path_s = DSModelElementsSelection()  # "01.Select Divided Path(s)"; nothing selected; graph input

code_block = CodeBlock { true; false; }
scopeIf = Custom[CW.ScopeIf+](VARtest=n02_name_points, VARtrue=n03_numbering_sequence_false, VARfalse=code_block.out1)  # package Synthesize toolkit; A (hopefully) more robust implementation of ScopeIf. Tests a single boolean and returns a value accordingly.
code_block_2 = CodeBlock { "[0-9]+"; }
element_types = ElementTypes("ReferencePoint")
all_elements_of_type = ElementsOfType(element_type=element_types)
code_block_3 = CodeBlock { "Name"; }
getParameterValueByName = Element.GetParameterValueByName(element=all_elements_of_type, parameterName=code_block_3)
code_block_4 = CodeBlock { ""; }
eq = getParameterValueByName == code_block_4
filterByBoolMask = List.FilterByBoolMask(list=getParameterValueByName, mask=eq)
findRegularExpression = Custom[CW.String.FindRegularExpression](VARRegEx=code_block_2, VARstr=filterByBoolMask.out)  # package Synthesize toolkit; Returns all occurences of a regular expression within a string (or list of strings). The syntax for regular expressions is explained at http://ironpython-test.readthedocs.org/en/latest/howto/regex.html
flatten = List.Flatten(list=findRegularExpression)
toNumber = String.ToNumber(string=flatten)
uniqueItems = List.UniqueItems(list=toNumber)
sort = List.Sort(list=uniqueItems)
list_lastitem_fixer = Custom[List.LastItem Fixer](VARlist=sort)  # package Synthesize toolkit; List.LastItem Fixer
code_block_5 = CodeBlock { 1; }
add = list_lastitem_fixer + code_block_5
isNull = Object.IsNull(object=add)
code_block_6 = CodeBlock { 1; }
scopeIf_2 = Custom[CW.ScopeIf+](VARtest=isNull, VARtrue=code_block_6, VARfalse=add)
scopeIf_3 = Custom[CW.ScopeIf+](VARtest=n04_automatic_points_number, VARtrue=scopeIf_2, VARfalse=n05_custom_point_name_numbering)
code_block_7 = CodeBlock { "DividedPath"; }
byClassName = Custom[SP.Filter.ByClassName](VARobject=n01_select_divided_path_s, VARclassName=code_block_7)  # package Synthesize toolkit; Filters a list of objects by the object's class name. Note that Dynamo elements belong to different classes than their Revit counterparts. Use the Object.Class node to check an object's class.
curves = Element.Curves(element=byClassName.VARout)
isEmpty = List.IsEmpty(list=curves@L2)
filterByBoolMask_2 = List.FilterByBoolMask(list=byClassName.VARout, mask=isEmpty)
points = DividedPath.Points(dividedPath=byClassName.VARin)
flatten_2 = List.Flatten(list=points)
filterByBoolMask_3 = List.FilterByBoolMask(list=curves, mask=isEmpty)
flatten_3 = List.Flatten(list=filterByBoolMask_3.out@L2)
firstItem = List.FirstItem(list=flatten_3@L2)
flatten_4 = List.Flatten(list=firstItem)
doesIntersect = Geometry.DoesIntersect(geometry=flatten_4@L1, other=flatten_2@L2, lacing=Longest)
count = List.Count(list=doesIntersect)
ofRepeatedItem = List.OfRepeatedItem(item=flatten_2, amount=count)
filterByBoolMask_4 = List.FilterByBoolMask(list=ofRepeatedItem, mask=doesIntersect)
isEmpty_2 = List.IsEmpty(list=filterByBoolMask_4.in, lacing=Longest)
filterByBoolMask_5 = List.FilterByBoolMask(list=filterByBoolMask_2.out, mask=isEmpty_2)
filterByBoolMask_6 = List.FilterByBoolMask(list=flatten_4, mask=isEmpty_2)
filterByBoolMask_7 = List.FilterByBoolMask(list=filterByBoolMask_4.in, mask=isEmpty_2)
flatten_5 = List.Flatten(list=filterByBoolMask_7.out@L2)
count_2 = List.Count(list=flatten_5@L2)
flatten_6 = List.Flatten(list=flatten_5)
pruneDuplicates = Point.PruneDuplicates(points=flatten_6)
hot_index_of_item = Custom[HOT.Index of item](VARList=pruneDuplicates, VARItem=flatten_5@L1)  # package Synthesize toolkit; Index of Item on List
flatten_7 = List.Flatten(list=hot_index_of_item)
al_duplicate_item_indices = Custom[AL.Duplicate Item Indices](VARList=flatten_7)  # package Synthesize toolkit; Searches an input list for duplicate entries and lists their index numbers. Couple with Get From List to delete duplicates from a list.
code_block_8 = CodeBlock { null; }
replaceItemAtIndex = Custom[CW.List.ReplaceItemAtIndex+](VARseq=flatten_6, VARindex=al_duplicate_item_indices.VARDuplicateIndices, VARreplacement=code_block_8)  # package Synthesize toolkit; Replaces the item at a given index (or list of indices) of a list by another item
flatten_8 = List.Flatten(list=replaceItemAtIndex)
chopByLengths = Custom[CW.List.ChopByLengths](VARlengths=count_2, VARlist=flatten_8)  # package Synthesize toolkit; Turns a list into a list of lists with sublists of varying lengths.
code_block_9 = CodeBlock { false; }
clean = List.Clean(list=chopByLengths, preserveIndices=code_block_9)
isNull_2 = Object.IsNull(object=clean)
code_block_10 = CodeBlock { null; }
scopeIf_4 = Custom[CW.ScopeIf+](VARtest=isNull_2, VARtrue=flatten_5, VARfalse=code_block_10)
scopeIf_5 = Custom[CW.ScopeIf+](VARtest=isNull_2, VARtrue=code_block_10, VARfalse=clean)
create = List.Create(item0=scopeIf_4, item1=scopeIf_5)
code_block_11 = CodeBlock { false; }
clean_2 = List.Clean(list=create, preserveIndices=code_block_11)
flatten_9 = List.Flatten(list=clean_2@L2)
parameterAtPoint = Curve.ParameterAtPoint(curve=filterByBoolMask_6.out, point=flatten_9)
byParameterOnCurveReference = ReferencePoint.ByParameterOnCurveReference(elementCurveReference=filterByBoolMask_5.out, parameter=parameterAtPoint)
flatten_10 = List.Flatten(list=byParameterOnCurveReference)
end = Revit.Transaction.Transaction.End(input=flatten_10)
as_polycurve_bycurves = Custom[AS.[&] PolyCurve.ByCurves](VARcurves=flatten_4)  # package Synthesize toolkit; Create polycurves from an unordered list of curves.
point = ReferencePoint.Point(referencePoint=end)
doesIntersect_2 = Geometry.DoesIntersect(geometry=as_polycurve_bycurves.VARpolyCurve@L1, other=point)
count_3 = List.Count(list=doesIntersect_2)
ofRepeatedItem_2 = List.OfRepeatedItem(item=end, amount=count_3)
filterByBoolMask_8 = List.FilterByBoolMask(list=ofRepeatedItem_2, mask=doesIntersect_2)
code_block_12 = CodeBlock { false; }
clean_3 = List.Clean(list=filterByBoolMask_8.in, preserveIndices=code_block_12)
transpose = List.Transpose(lists=doesIntersect_2)
count_4 = List.Count(list=transpose)
ofRepeatedItem_3 = List.OfRepeatedItem(item=as_polycurve_bycurves.VARpolyCurve, amount=count_4)
filterByBoolMask_9 = List.FilterByBoolMask(list=ofRepeatedItem_3, mask=transpose)
flatten_11 = List.Flatten(list=filterByBoolMask_9.in)
uniqueItems_2 = List.UniqueItems(list=flatten_11)
point_2 = ReferencePoint.Point(referencePoint=clean_3)
parameterAtPoint_2 = Curve.ParameterAtPoint(curve=uniqueItems_2, point=point_2)
as_list_sortbykey = Custom[AS.[&] List.SortByKey](VARlist=clean_3, VARkeys=parameterAtPoint_2)  # package Synthesize toolkit; Sort a list (or lists) according to the order specified by the key list.
generate_sequenced_points = Custom[Generate Sequenced Points](VARNumberSequenceStart=scopeIf_3, VARReferencePoints=as_list_sortbykey.VARsortedlist, VARNamePoints=scopeIf)  # package Synthesize toolkit; Generate Sequenced Points
scopeIf_6 = Custom[CW.ScopeIf+](VARtest=n02_name_points, VARtrue=n03_numbering_sequence_false, VARfalse=code_block.out0)
code_block_13 = CodeBlock { null; }
scopeIf_7 = Custom[CW.ScopeIf+](VARtest=scopeIf_6, VARtrue=code_block_13, VARfalse=generate_sequenced_points.VARReferencePoints)
code_block_14 = CodeBlock { false; }
clean_4 = List.Clean(list=scopeIf_7, preserveIndices=code_block_14)
code_block_15 = CodeBlock { "Reference Point"; }
filterByString = Custom[ST.List.FilterByString](VARlist=clean_4, VARString=code_block_15)  # package Synthesize toolkit; Filter a list by a string match
count_5 = List.Count(list=filterByString.VARMatch)
code_block_16 = CodeBlock { 1; }
sequence = Sequence(start=scopeIf_3, amount=count_5, step=code_block_16, lacing=Longest)
string_from_object = FromObject(obj=sequence)
trimWhitespace = String.TrimWhitespace(string=string_from_object)
code_block_17 = CodeBlock { "Name"; }
code_block_18 = CodeBlock { 0.0001; }
sequence_2 = Sequence(start=code_block_18, amount=count_5, step=code_block_18, lacing=Longest)
string_from_object_2 = FromObject(obj=sequence_2)
setParameterByName = Element.SetParameterByName(element=filterByString.VARMatch, parameterName=code_block_17, value=string_from_object_2)
passthrough = Custom[CW.Passthrough](VARpassThrough=trimWhitespace, VARwaitFor=setParameterByName)  # package Synthesize toolkit; Forces a sequential order of execution. The node wired into the output of the Passthrough node will be executed *after* the node wired into the waitFor input (e.g. important for some Revit operations). The value of the passThrough input will be passed on to the node wired into the output port of the Passthrough node.
list_lastitem_fixer_2 = Custom[List.LastItem Fixer](VARlist=passthrough)
scopeIf_8 = Custom[CW.ScopeIf+](VARtest=scopeIf, VARtrue=generate_sequenced_points.VARLastPointName, VARfalse=list_lastitem_fixer_2)
code_block_19 = CodeBlock { null; 0; }
eq_2 = scopeIf_8 == code_block_19.out0
code_block_20 = CodeBlock { "Inactive"; }
scopeIf_9 = Custom[CW.ScopeIf+](VARtest=eq_2, VARtrue=code_block_20, VARfalse=scopeIf_8)
passthrough_2 = Custom[CW.Passthrough](VARpassThrough=filterByString.VARMatch, VARwaitFor=setParameterByName)
passthrough_3 = Custom[CW.Passthrough](VARpassThrough=code_block_17, VARwaitFor=setParameterByName)
setParameterByName_2 = Element.SetParameterByName(element=passthrough_2, parameterName=passthrough_3, value=passthrough)
count_6 = List.Count(list=setParameterByName_2)
scopeIf_10 = Custom[CW.ScopeIf+](VARtest=scopeIf_6, VARtrue=generate_sequenced_points.VARNumberofPoints, VARfalse=count_6)
eq_3 = scopeIf_10 == code_block_19.out1
scopeIf_11 = Custom[CW.ScopeIf+](VARtest=eq_3, VARtrue=code_block_20, VARfalse=scopeIf_10)

# group: Report
n01_last_point_name = Watch(scopeIf_9)  # "01.Last Point Name"; graph output
n02_number_of_points_re_named = Watch(scopeIf_11)  # "02.Number of points Re-named"; graph output

debug_python = Custom[Debug Python]()  # package Synthesize toolkit; Debug Python
