# Dynamo graph Conceptual.Faster UV Surface Intersects.dyn (Dynamo 2.13.1.3887)
# author: karam@aecedx.com
# packages: Synthesize toolkit 12.5.1

n01_select_divided_surfaces = DSModelElementsSelection()  # "01.Select Divided Surfaces"; nothing selected; graph input
code_block = CodeBlock { "DividedSurface"; }
byClassName = Custom[SP.Filter.ByClassName](VARobject=n01_select_divided_surfaces, VARclassName=code_block)  # package Synthesize toolkit; Filters a list of objects by the object's class name. Note that Dynamo elements belong to different classes than their Revit counterparts. Use the Object.Class node to check an object's class.
n02_select_intersects = DSModelElementsSelection()  # "02.Select Intersects"; nothing selected; graph input
code_block_2 = CodeBlock { "Reference Point"; }
filterByString = Custom[ST.List.FilterByString](VARlist=n02_select_intersects, VARString=code_block_2)  # package Synthesize toolkit; Filter a list by a string match
addIntersect = Custom[CW.DividedSurface.AddIntersect](VARdividedSurface=byClassName.VARin, VARelement=filterByString.VAROther)  # package Synthesize toolkit; Adds an intersect to a divided surface
debug_python = Custom[Debug Python]()  # package Synthesize toolkit; Debug Python
