# Dynamo graph Conceptual.Flatten Surfaces Onto Base Surface.dyn (Dynamo 2.13.1.3887)
# author: karam@aecedx.com
# packages: Synthesize toolkit 12.5.1

debug_python = Custom[Debug Python]()  # package Synthesize toolkit; Debug Python

# group: Input
n02_select_base_surface = DSFaceSelection()  # "02.Select Base Surface"; nothing selected; graph input
n01_select_surfaces_to_flatten = SelectFaces()  # "01.Select Surfaces To Flatten"; nothing selected; graph input
resolution = DoubleInput(0.1)  # "03.Resolution"; graph input

flatten_nurbs_surfaces = Custom[Flatten Nurbs Surfaces](VARSurfacesToFlatten=n01_select_surfaces_to_flatten, VARBaseSurface=n02_select_base_surface, VARResolution=resolution)  # package Synthesize toolkit; Flatten Nurbs Surfaces
flatten = List.Flatten(list=flatten_nurbs_surfaces)
code_block = CodeBlock { "Flattened Form"; }
dynamo_geometry_to_revit = Custom[Dynamo Geometry To Revit Compatibility](VARGeometryOrSat=flatten, VARSubcategory=code_block)  # package Synthesize toolkit; Dynamo Geometry To Revit Compatibility
passthrough = Custom[CW.Passthrough](VARpassThrough=n02_select_base_surface, VARwaitFor=dynamo_geometry_to_revit)  # package Synthesize toolkit; Forces a sequential order of execution. The node wired into the output of the Passthrough node will be executed *after* the node wired into the waitFor input (e.g. important for some Revit operations). The value of the passThrough input will be passed on to the node wired into the output port of the Passthrough node.
fromDynamoSurface = Custom[CW.Element.FromDynamoSurface](VARDynamoSurface=passthrough)  # package Synthesize toolkit; Returns the underlying Revit element of a given face
eraser = Custom[ST.Tool.Eraser](VARList=fromDynamoSurface)  # package Synthesize toolkit; Try to delete any element from project
