# Dynamo graph Conceptual.K-Section.dyn (Dynamo 2.13.1.3887)
# author: karam@aecedx.com
# packages: Synthesize toolkit 12.5.1

# group: Input
n05_subface_sequence_start = DoubleInput(1)  # "05.Subface Sequence Start"; graph input
n03_section_name = StringInput("K-Section")  # "03.Section Name"; graph input
n04_subface_name = StringInput("Face ")  # "04.Subface Name"; graph input
n02_method_1_vertical_faces_2 = IntegerSlider(4, range=1..4 step 1)  # "02.Method (1 = Vertical Faces | 2 = Horizontal Up Faces | 3 = Horizontal Down Faces | 4 = All Faces)"; graph input
n01_select_faces = SelectFaces()  # "01.Select Faces"; nothing selected; graph input
n07_activate_far_clipping = BoolSelector(false)  # "07.Activate Far Clipping ?"; graph input
n10_flip_section = BoolSelector(false)  # "10.Flip Section ?"; graph input
n09_section_location_front_offset = DoubleInput(1)  # "09.Section Location Front Offset"; graph input
n08_far_clip_offset = DoubleInput(100)  # "08.Far Clip Offset"; graph input
n11_proceed = BoolSelector(false)  # "11.Proceed ?"; graph input
n06_crop_region_offset_always = DoubleInput(2)  # "06.Crop Region Offset (Always Square Crop)"; graph input

code_block = CodeBlock { ""; " "; 0; }
code_block_2 = CodeBlock { 4; 1; 2; 3; null; false; }
eq = n02_method_1_vertical_faces_2 == code_block_2.out0
flatten = List.Flatten(list=n01_select_faces)
scopeIf = Custom[CW.ScopeIf+](VARtest=eq, VARtrue=flatten, VARfalse=code_block_2.out4)  # package Synthesize toolkit; A (hopefully) more robust implementation of ScopeIf. Tests a single boolean and returns a value accordingly.
eq_2 = n02_method_1_vertical_faces_2 == code_block_2.out1
filterByOrientation = Custom[CW.Surface.FilterByOrientation](VARsurfaces=flatten)  # package Synthesize toolkit; Sorts surfaces in three lists based on their orientation (vertical, horizontal up & horizontal down) and also returns three corresponding lists of booleans.
scopeIf_2 = Custom[CW.ScopeIf+](VARtest=eq_2, VARtrue=filterByOrientation.VARvertical, VARfalse=code_block_2.out4)
eq_3 = n02_method_1_vertical_faces_2 == code_block_2.out2
scopeIf_3 = Custom[CW.ScopeIf+](VARtest=eq_3, VARtrue=filterByOrientation.VARhorizontalUp, VARfalse=code_block_2.out4)
eq_4 = n02_method_1_vertical_faces_2 == code_block_2.out3
scopeIf_4 = Custom[CW.ScopeIf+](VARtest=eq_4, VARtrue=filterByOrientation.VARhorizontalDown, VARfalse=code_block_2.out4)
create = List.Create(item0=scopeIf, item1=scopeIf_2, item2=scopeIf_3, item3=scopeIf_4)
clean = List.Clean(list=create, preserveIndices=code_block_2.out5)
flatten_2 = List.Flatten(list=clean@L2)
k_section = Custom[K-Section](VARSubfaceSequenceStart=n05_subface_sequence_start, VARPrefixtoAdd=n03_section_name, VARPanelsMarkName=code_block.out1, VARSubfaceName=n04_subface_name, VARSuffixtoAdd=code_block.out0, VARSurfaces=flatten_2, VARIncludeSurfaceswithAreaGreaterthan=code_block.out2, VARActivateFarClipping=n07_activate_far_clipping, VARFlipSection=n10_flip_section, VARSectionLocationFrontOffset=n09_section_location_front_offset, VARFarClipOffset=n08_far_clip_offset, VARProceed=n11_proceed)  # package Synthesize toolkit; K-Section
count = List.Count(list=k_section.VARFaces)

# group: Result
n01_number_of_sections_to = Watch(count)  # "01.Number of Sections to Generate"; graph output

square_crop_region_curves_by = Custom[Square Crop Region Curves By Surface](VARSurfaces=k_section.VARSurface, VAROffset=n06_crop_region_offset_always)  # package Synthesize toolkit; Square Crop Region Curves By Surface
setCropBoxCurves = Custom[MAD.View.SetCropBoxCurves](VARViews=k_section.VARSectionView, VARCurves=square_crop_region_curves_by)  # package Synthesize toolkit; Input views and lists of curves to set the view crop regions
debug_python = Custom[Debug Python]()  # package Synthesize toolkit; Debug Python
