# Dynamo graph Conceptual.K-Slicer By SAT and Intersecting Curves.dyn (Dynamo 2.13.1.3887)
# author: karam@aecedx.com
# packages: Synthesize toolkit 12.5.1

debug_python = Custom[Debug Python]()  # package Synthesize toolkit; Debug Python

# group: Input
thickness = DoubleInput(0.5)  # "03.Thickness"; graph input
n08_union_pieces = BoolSelector(false)  # "08.Union Pieces ?"; graph input
n01_sat_file = Filename("No file selected.")  # "01.SAT File"; graph input
n02_select_intersecting_curves = DSModelElementsSelection()  # "02.Select Intersecting Curves"; nothing selected; graph input
n04_thicken_both_sides = BoolSelector(true)  # "04.Thicken Both Sides ?"; graph input
n09_one_family = BoolSelector(true)  # "09.One Family ?"; graph input
n10_family_name = StringInput("Dynamo Sliced Pieces")  # "10.Family Name"; graph input
n11_family_category = Categories("OST_GenericModel")  # "11.Family Category"; graph input
n13_family_template_of_the_above = Filename("..\..\..\ProgramData\Autodesk\RVT 2020\Family Templates\English\Metric Generic Model.rft")  # "13.Family Template of The Above Category"; graph input
material = StringInput("Default")  # "05.Material"; graph input
n07_material_single_parameter = BoolSelector(true)  # "07.Material: Single Parameter Only ?"; graph input
n06_material_is_instance = BoolSelector(false)  # "06.Material: Is Instance Parameter ?"; graph input
subcategory = StringInput("")  # "12.Subcategory"; graph input

better_geometry_importfromsat = Custom[Better Geometry.ImportFromSAT](VARSATFile=n01_sat_file)  # package Synthesize toolkit; Better Geometry.ImportFromSAT
solid_slicer = Custom[Solid Slicer](VARWidth=thickness, VARUnionPieces=n08_union_pieces, VARBodies=better_geometry_importfromsat, VARIntersectingElements=n02_select_intersecting_curves, VARThickenBothSides=n04_thicken_both_sides)  # package Synthesize toolkit; Slicer
flatten = List.Flatten(list=solid_slicer)
k_family_insert = Custom[K-Family Insert](VARGeometryorSAT=flatten, VAROneFamily=n09_one_family, VARFamilyName=n10_family_name, VARFamilyCategory=n11_family_category, VARFamilyTemplatePath=n13_family_template_of_the_above, VARMaterialName=material, VARIsOneMaterial=n07_material_single_parameter, VARIsMaterialInstance=n06_material_is_instance, VARSubcategory=subcategory)  # package Synthesize toolkit; K-Family Insert
