# Dynamo graph Conceptual.K-Slicer By Solid and Reference Face.dyn (Dynamo 2.13.1.3887)
# author: karam@aecedx.com
# packages: Synthesize toolkit 12.5.1

debug_python = Custom[Debug Python]()  # package Synthesize toolkit; Debug Python

# group: Input
n13_union_pieces = BoolSelector(false)  # "13.Union Pieces ?"; graph input
thickness = DoubleInput(0.5)  # "08.Thickness"; graph input
n09_thicken_both_sides = BoolSelector(true)  # "09.Thicken Both Sides ?"; graph input
n06_spacing_by_number_false_by = BoolSelector(false)  # "06.Spacing : By Number = False | By Distance = True"; graph input
n07_number_distance = DoubleInput(5)  # "07.Number/Distance"; graph input
n05_direction_u_false_v_true = BoolSelector(false)  # "05.Direction : U = False | V = True"; graph input
n01_select_face_reference = DSFaceSelection()  # "01.Select Face Reference"; nothing selected; graph input
n04_select_solid = DSModelElementSelection()  # "04.Select Solid"; nothing selected; graph input
n02_re_loft_faces = BoolSelector(false)  # "02.Re-Loft Faces ?"; graph input
n03_re_loft_faces_distancing = DoubleInput(2)  # "03.Re-Loft Faces : Distancing"; graph input
n14_one_family = BoolSelector(true)  # "14.One Family ?"; graph input
n15_family_name = StringInput("Dynamo Sliced Pieces")  # "15.Family Name"; graph input
n16_family_category = Categories("OST_GenericModel")  # "16.Family Category"; graph input
n18_family_template_of_the_above = Filename("..\..\..\ProgramData\Autodesk\RVT 2020\Family Templates\English\Metric Generic Model.rft")  # "18.Family Template of The Above Category"; graph input
material = StringInput("Default")  # "10.Material"; graph input
n12_material_single_parameter = BoolSelector(true)  # "12.Material: Single Parameter Only ?"; graph input
n11_material_is_instance = BoolSelector(false)  # "11.Material: Is Instance Parameter ?"; graph input
subcategory = StringInput("")  # "17.Subcategory"; graph input

surface_importer = Custom[Surface Importer](VARSurfaces=n01_select_face_reference)  # package Synthesize toolkit; Surface Importer Node
surfaces = PolySurface.Surfaces(polySurface=surface_importer)
flatten = List.Flatten(list=surfaces)
update_dynamo_wait = Custom[Update Dynamo Wait](VARWait=n04_select_solid)  # package Synthesize toolkit; Update Dynamo Wait
element_geometry_fixer = Custom[Element.Geometry Fixer](VARElement=update_dynamo_wait)  # package Synthesize toolkit; Element.Geometry Fixer
solid_by_face_reference_slicer = Custom[Solid By Face Reference Slicer](VARUnionPieces=n13_union_pieces, VARthickness=thickness, VARthickenbothsides=n09_thicken_both_sides, VARFalseByNumberTrueByDistance=n06_spacing_by_number_false_by, VARNumberDistance=n07_number_distance, VARDirectionUFalseVTrue=n05_direction_u_false_v_true, VARSurfaces=flatten, VARGeometry=element_geometry_fixer, VARReloft=n02_re_loft_faces, VARReloftDistancing=n03_re_loft_faces_distancing)  # package Synthesize toolkit; Solid By Face Reference Slicer
flatten_2 = List.Flatten(list=solid_by_face_reference_slicer)
k_family_insert = Custom[K-Family Insert](VARGeometryorSAT=flatten_2, VAROneFamily=n14_one_family, VARFamilyName=n15_family_name, VARFamilyCategory=n16_family_category, VARFamilyTemplatePath=n18_family_template_of_the_above, VARMaterialName=material, VARIsOneMaterial=n12_material_single_parameter, VARIsMaterialInstance=n11_material_is_instance, VARSubcategory=subcategory)  # package Synthesize toolkit; K-Family Insert
