# Dynamo graph Conceptual.Mass Floor Lines Intersects By Custom Levels.dyn (Dynamo 2.13.1.3887)
# author: karam@aecedx.com
# packages: Synthesize toolkit 12.5.1

# group: Input
n03_create_selection_filter = BoolSelector(true)  # "03.Create Selection Filter ?"; graph input
n04_mass_floor_lines_filter_name = StringInput("Dynamo Generated Mass Floor Lines")  # "04.Mass Floor Lines Filter Name"; graph input
n05_overwrite_existing_filter = BoolSelector(false)  # "05.Overwrite Existing Filter ? (False for Adding Elements)"; graph input
n01_select_levels = DSModelElementsSelection()  # "01.Select Levels"; nothing selected; graph input
n02_select_masses = DSModelElementsSelection()  # "02.Select Masses"; nothing selected; graph input

element_geometry_fast = Custom[Element.Geometry Fast](VARElements=n02_select_masses)  # package Synthesize toolkit; Element.Geometry Fast
explode = Geometry.Explode(geometry=element_geometry_fast)
explode_2 = Geometry.Explode()  # unwired: geometry
map = List.Map(list=explode, f_x=explode_2)
mass_floor_lines_intersects = Custom[Mass Floor Lines Intersects](VARCreateSelectionFilter=n03_create_selection_filter, VARFilterNametoCreate=n04_mass_floor_lines_filter_name, VAROverwriteExistingFilter=n05_overwrite_existing_filter, VARLevels=n01_select_levels, VARSurfaces=map)  # package Synthesize toolkit; Mass Floor Lines Intersects
debug_python_no_message = Custom[Debug Python No Message]()  # package Synthesize toolkit; Debug Python
