# Dynamo graph Conceptual.Mass Split Updater.dyn (Dynamo 2.13.1.3887)
# author: karam@aecedx.com
# packages: Synthesize toolkit 12.5.1

debug_python = Custom[Debug Python]()  # package Synthesize toolkit; Debug Python

# group: Input
n03_options_splitter_thickness = DoubleInput(0.1)  # "03.Options : Splitter Thickness"; graph input
n02_options_detection_tollerate = DoubleInput(0.5)  # "02.Options : Detection Tollerate"; graph input
n04_options_split_extend_distance = DoubleInput(1)  # "04.Options : Split Extend Distance"; graph input
n05_options_points_distancing = DoubleInput(0.5)  # "05.Options : Points Distancing"; graph input
n01_options_pull_curves_onto = BoolSelector(false)  # "01.Options : Pull Curves Onto Surfaces ?"; graph input
n06_family_name = StringInput("Dynamo Splitted Mass")  # "06.Family Name"; graph input
n07_family_category = Categories("OST_Mass")  # "07.Family Category"; graph input
n08_family_template_of_the_above = Filename("..\..\..\..\..\..\..\..\..\..\ProgramData\Autodesk\RVT 2020\Family Templates\English\Conceptual Mass\Metric Mass.rft")  # "08.Family Template of The Above Category"; graph input

mass_split_updater = Custom[Mass Split Updater](VARSplitterThickness=n03_options_splitter_thickness, VARDetectionTollerance=n02_options_detection_tollerate, VARSplitExtendDistance=n04_options_split_extend_distance, VARPointsDistancing=n05_options_points_distancing, VARPullOrNot=n01_options_pull_curves_onto)  # package Synthesize toolkit; Mass Split Updater
k_family_insert = Custom[K-Family Insert](VARGeometryorSAT=mass_split_updater.VARGeometry, VARFamilyName=n06_family_name, VARFamilyCategory=n07_family_category, VARFamilyTemplatePath=n08_family_template_of_the_above)  # package Synthesize toolkit; K-Family Insert
python_script = Python(IN[0]=mass_split_updater.VARElements, IN[1]=mass_split_updater.VASplitters, IN[2]=k_family_insert.VARFamilyInstancesOrImportSymbols)  # IronPython2
# ---------- python_script.python (109 lines) ----------
# Enable Python support and load DesignScript library
# IMPORTANT : ALL DYNAMO DESIGN SCRIPT NODES ARE AS (dg)
import clr
clr.AddReference('ProtoGeometry')
from Autodesk.DesignScript import Geometry as dg

# EXTENSION Enable ToDSType
clr.AddReference('RevitNodes')
import Revit
clr.ImportExtensions(Revit.Elements)

# Enable Revit Elements
from Revit.Elements import *

# EXTENSION Enable Geometry Conversion Methods
clr.ImportExtensions(Revit.GeometryConversion)

# Enable Revit API
clr.AddReference('RevitAPI')
from Autodesk.Revit.DB import *

# Enable DocumentManager and TransactionManager
clr.AddReference('RevitServices')
from RevitServices.Persistence import DocumentManager
from RevitServices.Transactions import TransactionManager

# Enable ICollection List Translate
clr.AddReference("System")
import System.Collections.Generic
from System.Collections.Generic import List

def tolist(obj1):
	if hasattr(obj1,'__iter__'): return obj1
	else: return [obj1]

# Choose The Current Document
doc = DocumentManager.Instance.CurrentDBDocument
uidoc = DocumentManager.Instance.CurrentUIApplication.ActiveUIDocument
uiapp = DocumentManager.Instance.CurrentUIApplication
app = uiapp.Application

dataEnteringNode = IN
# Use UnwrapElement(IN[0]) When Translating From Dynamo to Revit

forms = UnwrapElement(tolist(IN[0]))
splitters = UnwrapElement(tolist(IN[1]))


# Create Empty List
result = []

tmplist = []
for each in forms:
	tmplist.append(str(each.Id))
joined = "-".join(tmplist)

tmplist = []
for each in splitters:
	tmplist.append(str(each.Id))
joined2 = "-".join(tmplist)

joinedall = joined + "_" + joined2

#collect all views in the model
collector = FilteredElementCollector(doc)
filters = collector.OfClass(FilterElement).ToElements()
fnames = []
acceptedfilters = []
for each in filters:
	if each.ToString() == "Autodesk.Revit.DB.SelectionFilterElement":
		if each.IsEmpty() == False and "DONOTDELETE-DYNAMOSPLIT" in each.Name:
			fnames.append(each.Name)
			acceptedfilters.append(each)

if len(fnames) != 0:
	sequences = []
	for each in fnames:
		split = each.split(",")
		sequences.append(int(split[2]))
	uniqueseq = sorted(list(set(sequences)))
	lastseq = uniqueseq[-1] + 1
else:
	lastseq = 1

filter1name = "DONOTDELETE-DYNAMOSPLIT," + joinedall + "," + str(lastseq)

profs = UnwrapElement(tolist(IN[2]))

profset = []
# create itemset
ids = list()
for item in profs:
	ids.append(item.Id)
profset = List[ElementId](ids)

TransactionManager.Instance.EnsureInTransaction(doc)
try:
	selset1 = SelectionFilterElement.Create(doc,filter1name)
except:
	for each in filters:
		if each.ToString() == "Autodesk.Revit.DB.SelectionFilterElement":
			if filter1name == each.Name:
				selset1 = each
				selset1.Clear()
# add the items to the selection set
selset1.AddSet(profset)
TransactionManager.Instance.TransactionTaskDone()

OUT = selset1.ToDSType(False)
# ----------------------------------------
