# Dynamo graph Conceptual.Nurbs Surface By All Elements of Active View.dyn (Dynamo 2.13.1.3887)
# author: karam@aecedx.com
# packages: Synthesize toolkit 12.5.1

python_all_elements_in_active = Custom[Python All Elements In Active View]()  # package Synthesize toolkit; Python All Elements In Active View
element_geometry_fast = Custom[Element.Geometry Fast](VARElements=python_all_elements_in_active)  # package Synthesize toolkit; Element.Geometry Fast
flatten = List.Flatten(list=element_geometry_fast)
explode = Geometry.Explode(geometry=flatten)
flatten_2 = List.Flatten(list=explode)
toNurbsSurface = Surface.ToNurbsSurface(surface=flatten_2)

# group: Input
material = StringInput("")  # "01.Material"; graph input

code_block = CodeBlock { "Full Nurbs Surface"; }
dynamo_geometry_to_revit = Custom[Dynamo Geometry To Revit Compatibility](VARGeometryOrSat=toNurbsSurface, VARMaterialName=material, VARSubcategory=code_block)  # package Synthesize toolkit; Dynamo Geometry To Revit Compatibility
debug_python_no_message = Custom[Debug Python No Message]()  # package Synthesize toolkit; Debug Python
