# Dynamo graph Conceptual.Scale Updater.dyn (Dynamo 2.13.1.3887)
# author: karam@aecedx.com
# packages: Synthesize toolkit 12.5.1

# group: Input
n02_update_scaling_settings = BoolSelector(false)  # "02.Update Scaling Settings"; graph input
n09_custom_family_template = BoolSelector(false)  # "09.Custom Family Template"; graph input
n04_update_new_x = DoubleInput(1)  # "04.Update New X"; graph input
n03_update_old_x = DoubleInput(1)  # "03.Update Old X"; graph input
n06_update_new_y = DoubleInput(1)  # "06.Update New Y"; graph input
n05_update_old_y = DoubleInput(1)  # "05.Update Old Y"; graph input
n08_update_new_z = DoubleInput(1)  # "08.Update New Z"; graph input
n07_update_old_z = DoubleInput(1)  # "07.Update Old Z"; graph input
n10_custom_family_template = Filename("..\..\..\..\..\..\..\..\..\..\ProgramData\Autodesk\RVT 2020\Family Templates\English\Conceptual Mass\Metric Mass.rft")  # "10.Custom Family Template : Conceptual Mass Template (.rft)"; graph input
n01_keep_adjacet_surface_joined = BoolSelector(true)  # "01.Keep Adjacet Surface Joined"; graph input

scale_updater = Custom[Scale Updater](VARUpdateScalingSettings=n02_update_scaling_settings, VARCustomFamilyTemplate=n09_custom_family_template, VARUpdateNewX=n04_update_new_x, VARUpdateOLDX=n03_update_old_x, VARUpdateNewY=n06_update_new_y, VARUpdateOldNewY=n05_update_old_y, VARUpdateNewZ=n08_update_new_z, VARUpdateOldZ=n07_update_old_z, VARRFTFile=n10_custom_family_template, VARKeepAdjacentSurfacesJoined=n01_keep_adjacet_surface_joined)  # package Synthesize toolkit; Scale Updater
debug_python_no_message = Custom[Debug Python No Message]()  # package Synthesize toolkit; Debug Python
