# Dynamo graph Conceptual.T-Spline Pipes By Lines Selection.dyn (Dynamo 2.13.1.3887)
# author: karam@aecedx.com
# packages: Synthesize toolkit 12.5.1

# group: Input
n08_export_tsm = BoolSelector(false)  # "08.Export TSM ?"; graph input
n01_select_lines = DSModelElementsSelection()  # "01.Select Lines"; nothing selected; graph input
n05_simple_radius = DoubleInput(0.5)  # "05.Simple: Radius"; graph input
n02_snapping_tolerance = DoubleInput(0.001)  # "02.Snapping Tolerance"; graph input
n03_joints_sharpness = DoubleInput(2)  # "03.Joints Sharpness"; graph input
n04_method_simple_false_advanced = BoolSelector(false)  # "04.Method : Simple = False | Advanced = True"; graph input
n06_advanced_start_radius = DoubleInput(0.5)  # "06.Advanced: Start Radius"; graph input
n07_advanced_end_radius = DoubleInput(0.5)  # "07.Advanced: End Radius"; graph input
n09_tsm_file_path = StringInput("D:\ExportedTspline.tsm")  # "09.TSM File Path"; graph input
n11_family_method_family_name = StringInput("Dynamo T-Spline Form")  # "11.Family Method : Family Name"; graph input
n13_family_method_family_category = Categories("OST_GenericModel")  # "13.Family Method : Family Category"; graph input
n14_family_method_family_template = Filename("..\..\..\..\..\..\..\..\..\..\ProgramData\Autodesk\RVT 2020\Family Templates\English\Metric Generic Model.rft")  # "14.Family Method : Family Template of The Above Category"; graph input
n12_family_method_material = StringInput("")  # "12.Family Method : Material"; graph input
n10_method_false_imported_object = BoolSelector(true)  # "10.Method : False = Imported Object | True = Family"; graph input

helix_to_curves = Custom[Helix to Curves](VARHelixElements=n01_select_lines)  # package Synthesize toolkit; Helix to Curves
flatten = List.Flatten(list=helix_to_curves)
code_block = CodeBlock { true; }
ne = code_block != n04_method_simple_false_advanced
code_block_2 = CodeBlock { 0; 1; }

# group: In Dynamo Inputs
smooth_mode_in_dynamo = BoolSelector(false)

buildPipes = TSpline.TSplineSurface.BuildPipes(curves=flatten, defaultRadius=n05_simple_radius, snappingTolerance=n02_snapping_tolerance, segmentsCount=n03_joints_sharpness, autoHandleStart=ne, autoHandleEnd=ne, startRotations=code_block_2.out1, endRotations=code_block_2.out0, startRadii=n06_advanced_start_radius, endRadii=n07_advanced_end_radius, startPositions=code_block_2.out1, endPositions=code_block_2.out0, inSmoothMode=smooth_mode_in_dynamo)
empty = List.Empty()
scopeIf = Custom[CW.ScopeIf+](VARtest=n08_export_tsm, VARtrue=buildPipes, VARfalse=empty)  # package Synthesize toolkit; A (hopefully) more robust implementation of ScopeIf. Tests a single boolean and returns a value accordingly.
exportToTSM = TSpline.TSplineSurface.ExportToTSM(tSplineSurface=scopeIf, filePath=n09_tsm_file_path)
debug_python_no_message = Custom[Debug Python No Message]()  # package Synthesize toolkit; Debug Python
empty_2 = List.Empty()
scopeIf_2 = Custom[CW.ScopeIf+](VARtest=smooth_mode_in_dynamo, VARtrue=empty_2, VARfalse=buildPipes)
scopeIf_3 = Custom[CW.ScopeIf+](VARtest=n08_export_tsm, VARtrue=empty_2, VARfalse=scopeIf_2)
toBRep = TSpline.TSplineSurface.ToBRep(tSplineSurface=scopeIf_3)
code_block_3 = CodeBlock { true; }
ne_2 = code_block_3 != n10_method_false_imported_object
k_family_insert = Custom[K-Family Insert](VARGeometryorSAT=toBRep, VARFamilyName=n11_family_method_family_name, VARFamilyCategory=n13_family_method_family_category, VARFamilyTemplatePath=n14_family_method_family_template, VARMaterialName=n12_family_method_material, VARImportInstanceInstead=ne_2)  # package Synthesize toolkit; K-Family Insert
