# Dynamo graph Conceptual.Transform Flat Lines Onto Origin Level.dyn (Dynamo 2.13.1.3887)
# author: karam@aecedx.com
# packages: Synthesize toolkit 12.5.1

# group: Input
n04_create_selection_filter_for = BoolSelector(false)  # "04.Create Selection Filter for Pulled Curves ?"; graph input
n05_filter_name_to_create_for = StringInput("Dynamo Pulled Curves")  # "05.Filter Name to Create for Pulled Curves"; graph input
n06_overwrite_existing_filter = BoolSelector(false)  # "06.Overwrite Existing Filter ?"; graph input
n01_select_level_to_be_pulled = Levels("Level 1")  # "01.Select Level to be Pulled Onto"; graph input
n03_rotation_degree = DoubleInput(0)  # "03.Rotation Degree"; graph input
n02_select_curves_to_flatten_onto = DSModelElementsSelection()  # "02.Select Curves to Flatten Onto Level"; nothing selected; graph input

transform_lines_and_reference = Custom[Transform Lines and Reference Points Onto Level Origin](VARlevel=n01_select_level_to_be_pulled, VARdegrees=n03_rotation_degree, VARElements=n02_select_curves_to_flatten_onto)  # package Synthesize toolkit; Transform Lines and Reference Points Onto Level Origin
byCurve = ModelCurve.ByCurve(curve=transform_lines_and_reference.VARCurves)
generate_selection_filter = Custom[Generate Selection Filter](VARCreateSelectionFilter=n04_create_selection_filter_for, VARFilterNametoCreate=n05_filter_name_to_create_for, VAROverwriteExistingFilter=n06_overwrite_existing_filter, VARElements=byCurve)  # package Synthesize toolkit; Generate Selection FIlter
debug_python = Custom[Debug Python]()  # package Synthesize toolkit; Debug Python
create = List.Create(item0=transform_lines_and_reference.VARPoints)
byPoint = ReferencePoint.ByPoint()  # unwired: pt
map = List.Map(list=create, f_x=byPoint)
