# Dynamo graph Conceptual.Transform Flat Lines Onto Picked Faces.dyn (Dynamo 2.13.1.3887)
# author: karam@aecedx.com
# packages: Synthesize toolkit 12.5.1

# group: Input
n03_create_selection_filter_for = BoolSelector(false)  # "03.Create Selection Filter for Pulled Curves ?"; graph input
n04_filter_name_to_create_for = StringInput("Dynamo Pulled Curves")  # "04.Filter Name to Create for Pulled Curves"; graph input
n05_overwrite_existing_filter = BoolSelector(false)  # "05.Overwrite Existing Filter ?"; graph input
n01_select_curves_to_flatten_onto = DSModelElementsSelection()  # "01.Select Curves to Flatten Onto Level"; nothing selected; graph input
n02_rotation_degree = DoubleInput(0)  # "02.Rotation Degree"; graph input

curves = Element.Curves(element=n01_select_curves_to_flatten_onto)
flatten = List.Flatten(list=curves)
code_block = CodeBlock { 6; 0; 1; }
sequence = Sequence(amount=code_block.out0, lacing=Longest)
remapRange = Math.RemapRange(numbers=sequence)
pointAtParameter = Curve.PointAtParameter(curve=flatten@L1, param=remapRange)
flatten_2 = List.Flatten(list=pointAtParameter)
pruneDuplicates = Custom[SP.Points.PruneDuplicates+](VARpoints=flatten_2)  # package Synthesize toolkit; An alternative to the built in node, that performs faster at the price of loosing the order of the points. All floating point valies are rounded to the nearest 4 decimal points. You can optionally remove duplicate Z values by setting "keepDuplicateZ" to false.
byBestFitThroughPoints = Plane.ByBestFitThroughPoints(points=pruneDuplicates)
byPlane = CoordinateSystem.ByPlane(plane=byBestFitThroughPoints)
selectFaces = Custom[SP.SelectFaces+]()  # package Synthesize toolkit; Select multiple faces from inside the Revit UI. Be sure to press "Finish" once done. Unlike the built-in node, face references of instances will be added sucessfully and you'l get the pick points. You can use a Boolean toggle to refresh your selection.
normalAtPoint = Surface.NormalAtPoint(surface=selectFaces.VARfaces, point=selectFaces.VARpickPoints)
byOriginNormal = Plane.ByOriginNormal(origin=selectFaces.VARpickPoints, normal=normalAtPoint)
byPlane_2 = CoordinateSystem.ByPlane(plane=byOriginNormal)
rotate = CoordinateSystem.Rotate(coordinateSystem=byPlane_2, plane=byOriginNormal, degrees=n02_rotation_degree)
transform = Geometry.Transform(geometry=flatten, fromCoordinateSystem=byPlane, contextCoordinateSystem=rotate@L1)
byCurve = ModelCurve.ByCurve(curve=transform)
generate_selection_filter = Custom[Generate Selection Filter](VARCreateSelectionFilter=n03_create_selection_filter_for, VARFilterNametoCreate=n04_filter_name_to_create_for, VAROverwriteExistingFilter=n05_overwrite_existing_filter, VARElements=byCurve)  # package Synthesize toolkit; Generate Selection FIlter
debug_python = Custom[Debug Python]()  # package Synthesize toolkit; Debug Python
