# Dynamo graph Conceptual.UV Lines Extract.dyn (Dynamo 2.13.1.3887)
# author: karam@aecedx.com
# packages: Synthesize toolkit 12.5.1

# group: Input
n05_create_selection_filter = BoolSelector(true)  # "05.Create Selection Filter ?"; graph input
n06_selection_filter_name = StringInput("Dynamo Extracted UV Grid")  # "06.Selection Filter Name"; graph input
U = DoubleInput(10)  # "02.U"; graph input
V = DoubleInput(10)  # "03.V"; graph input
n01_select_faces = SelectFaces()  # "01.Select Faces"; nothing selected; graph input
n04_false_u_grid_true_v_grid = BoolSelector(false)  # "04.False = U Grid | True = V Grid"; graph input

code_block = CodeBlock { false; }
extract_uv_revit_lines = Custom[Extract UV Revit Lines](VARu=U, VARv=V, VARSurfaces=n01_select_faces, VARUFalseVTrue=n04_false_u_grid_true_v_grid)  # package Synthesize toolkit; Extract UV Revit Lines
create = List.Create(item0=extract_uv_revit_lines.VARCurveByPoints, item1=extract_uv_revit_lines.VARReferencePoints)
generate_selection_filter = Custom[Generate Selection Filter](VARCreateSelectionFilter=n05_create_selection_filter, VARFilterNametoCreate=n06_selection_filter_name, VAROverwriteExistingFilter=code_block, VARElements=create)  # package Synthesize toolkit; Generate Selection FIlter
debug_python = Custom[Debug Python]()  # package Synthesize toolkit; Debug Python
