# Dynamo graph Conceptual.UV Management By Selected Faces.dyn (Dynamo 2.13.1.3887)
# author: karam@aecedx.com
# packages: Synthesize toolkit 12.5.1

# group: Input
n08_reference_planes_names_prefix = StringInput("Dynamo Intersecting Plane")  # "08.Reference Planes Names Prefix"; graph input
n09_flip_reference_planes_side = BoolSelector(false)  # "09.Flip Reference Planes Side ?"; graph input
n10_reference_planes_offset = DoubleInput(15)  # "10.Reference Planes Offset"; graph input
n03_number_distance_u = DoubleInput(5)  # "03.Number/Distance U"; graph input
n05_number_distance_v = DoubleInput(5)  # "05.Number/Distance V"; graph input
n02_u_spacing_method_false_by = BoolSelector(false)  # "02.U Spacing Method (False = By Number | True = Spacing)"; graph input
n04_v_spacing_method_false_by = BoolSelector(false)  # "04.V Spacing Method (False = By Number | True = Spacing)"; graph input
n07_lines_extend = DoubleInput(1)  # "07.Lines Extend"; graph input
n06_control_points_precision = DoubleInput(0.2)  # "06.Control Points Precision"; graph input
n01_select_faces = SelectFaces()  # "01.Select Faces"; nothing selected; graph input

flatten = List.Flatten(list=n01_select_faces)
fromDynamoSurface = Custom[CW.RevitFaceReference.FromDynamoSurface](VARDynamoSurface=flatten)  # package Synthesize toolkit; Returns the underlying Revit face reference of a given surface
smart_planar_divided_surface = Custom[Smart Planar Divided Surface](VARReferencePlaneNamePrefix=n08_reference_planes_names_prefix, VARFlipReferencePlanesSide=n09_flip_reference_planes_side, VARReferencePlanesOffset=n10_reference_planes_offset, VARNumberDistanceU=n03_number_distance_u, VARNumberDistanceV=n05_number_distance_v, VARUSpacingMethod=n02_u_spacing_method_false_by, VARVSpacingMethod=n04_v_spacing_method_false_by, VARLinesExtend=n07_lines_extend, VARControlPointsPrecision=n06_control_points_precision, VARRevitFacesReference=fromDynamoSurface, VARSurfaces=flatten)  # package Synthesize toolkit; Smart Planar Divided Surface
