# Dynamo graph Conceptual.UV Management Complex T-Surface By Lines.dyn (Dynamo 2.13.1.3887)
# author: karam@aecedx.com
# packages: Synthesize toolkit 12.5.1

# group: Input
n25_create_selection_filter = BoolSelector(true)  # "25.Create Selection Filter ?"; graph input
n26_filter_name_to_create = StringInput("Dynamo Generated Points or Curves")  # "26.Filter Name to Create"; graph input
n27_overwrite_existing_filter = BoolSelector(false)  # "27.Overwrite Existing Filter ? (False for Adding Elements)"; graph input
n10_u_grid = DoubleInput(2)  # "10.U Grid"; graph input
n11_v_grid = DoubleInput(2)  # "11.V Grid"; graph input
n19_number_of_control_points_per = DoubleInput(2)  # "19.Number of Control Points Per Line"; graph input
n18_draw_uv_grid_lines = BoolSelector(false)  # "18.Draw UV Grid Lines ?"; graph input
n20_extra_extended_distance_per = DoubleInput(1)  # "20.Extra Extended Distance Per Line"; graph input
n21_with_points_for_uv_grid_lines = BoolSelector(true)  # "21.With Points (For UV Grid Lines) ?"; graph input
n14_place_uv_points = BoolSelector(false)  # "14.Place UV Points ?"; graph input
n16_automatic_points_number = BoolSelector(true)  # "16.Automatic Points Number Detection ? (False for Custom)"; graph input
n17_custom_point_name_numbering = DoubleInput(1)  # "17.Custom Point Name Numbering Sequence Start"; graph input
n15_name_points_by_u_false_by_v = BoolSelector(false)  # "15.Name Points By U = False | By V = True"; graph input
n06_import_solid_surface_to_revit = BoolSelector(true)  # "06.Import Solid/Surface to Revit ?"; graph input
n12_alternative_u_panelling = BoolSelector(false)  # "12.Alternative U Panelling ?"; graph input
n13_alternative_v_panelling = BoolSelector(false)  # "13.Alternative V Panelling ?"; graph input
n01_select_lines = DSModelElementsSelection()  # "01.Select Lines"; nothing selected; graph input
n03_max_face_valence = DoubleInput(4)  # "03.Max Face Valence"; graph input
n02_snapping_tolerance = DoubleInput(0.001)  # "02.Snapping Tolerance"; graph input
n04_crease_outer_vertices = BoolSelector(false)  # "04.Crease Outer Vertices"; graph input
n05_smooth_mode = BoolSelector(true)  # "05.Smooth Mode ?"; graph input
n08_family_method_family_name = StringInput("Dynamo Generated Face")  # "08.Family Method : Family Name"; graph input
n09_family_method_start_sequence = DoubleInput(1)  # "09.Family Method : Start Sequence (Naming Suffix)"; graph input
n07_method_false_imported_object = BoolSelector(true)  # "07.Method : False = Imported Object | True = Family"; graph input
n22_reference_plane_name_prefix = StringInput("UV Management Ref Plane")  # "22.Reference Plane Name Prefix"; graph input
n23_reference_plane_offset = DoubleInput(5)  # "23.Reference Plane Offset"; graph input
n24_flip_reference_planes_side = BoolSelector(false)  # "24.Flip Reference Planes Side"; graph input

curves = Element.Curves(element=n01_select_lines)
flatten = List.Flatten(list=curves)
buildFromLines = TSpline.TSplineSurface.BuildFromLines(lines=flatten, maxFaceValence=n03_max_face_valence, snappingTolerance=n02_snapping_tolerance, creaseOuterVertices=n04_crease_outer_vertices, inSmoothMode=n05_smooth_mode)
code_block = CodeBlock { false; }
toBRep = TSpline.TSplineSurface.ToBRep(tSplineSurface=buildFromLines, matchTopology=code_block)
byJoinedSurfaces = PolySurface.ByJoinedSurfaces(surfaces=toBRep)
surfaces = PolySurface.Surfaces(polySurface=byJoinedSurfaces)
toNurbsSurface = Surface.ToNurbsSurface(surface=surfaces)
family_method_family_template_of = Filename("..\..\..\..\..\..\..\..\..\..\ProgramData\Autodesk\RVT 2020\Family Templates\English\Metric Generic Model.rft")  # "Family Method : Family Template of The Above Category"
current = Document.Current()
isFamilyDocument = Document.IsFamilyDocument(document=current)
family_method_category = Categories("OST_Mass")
family_method_category_2 = Categories("OST_GenericModel")
scopeIf = Custom[CW.ScopeIf+](VARtest=isFamilyDocument, VARtrue=family_method_category, VARfalse=family_method_category_2)  # package Synthesize toolkit; A (hopefully) more robust implementation of ScopeIf. Tests a single boolean and returns a value accordingly.
smart_rft_path = Custom[Smart RFT Path](VARRFTFile=family_method_family_template_of, VARCategory=scopeIf)  # package Synthesize toolkit; Smart RFT Path
uv_management = Custom[UV Management](VARCreateSelectionFilter=n25_create_selection_filter, VARFilterNametoCreate=n26_filter_name_to_create, VAROverwriteExistingFilter=n27_overwrite_existing_filter, VARUGrid=n10_u_grid, VARVGrid=n11_v_grid, VARNumberofControlPointsPerLine=n19_number_of_control_points_per, VARDrawLines=n18_draw_uv_grid_lines, VARExtraExtendedDistance=n20_extra_extended_distance_per, VARLinesWithPoints=n21_with_points_for_uv_grid_lines, VARPlacePoints=n14_place_uv_points, VARAutomaticPointsNumberDetectionFalseforCustom=n16_automatic_points_number, VARCustomPointNameNumberingSequenceStart=n17_custom_point_name_numbering, VARDivideByU=n15_name_points_by_u_false_by_v, VARImporttoRevit=n06_import_solid_surface_to_revit, VARParametricU=n12_alternative_u_panelling, VARParametricV=n13_alternative_v_panelling, VARNurbsSurfaces=toNurbsSurface, VARMassFamilyName=n08_family_method_family_name, VARStartSequenceNamingSuffix=n09_family_method_start_sequence, VARConceptualMassTemplate=smart_rft_path, VARMethodFalse=n07_method_false_imported_object, VARSurfaceorSolid=toNurbsSurface, VARReferencePlaneNamePrefix=n22_reference_plane_name_prefix, VARReferencePlanesOffset=n23_reference_plane_offset, VARFlipReferencePlanesSide=n24_flip_reference_planes_side, VARCategory=scopeIf)  # package Synthesize toolkit; UV Management

# group: Report
n01_family_method_report = Watch(uv_management.VARFamilyMethodReport)  # "01.Family Method Report"; graph output
n02_last_point_name = Watch(uv_management.VARLastPointName)  # "02.Last Point Name"; graph output
n03_number_of_generated_points = Watch(uv_management.VARNumberofPoints)  # "03.Number of Generated Points"; graph output

debug_python = Custom[Debug Python]()  # package Synthesize toolkit; Debug Python
