# Dynamo graph Conceptual.UV Management Loft Curves With Curves - Updater.dyn (Dynamo 2.13.1.3887)
# author: karam@aecedx.com
# packages: Synthesize toolkit 12.5.1

# group: Input
n20_custom_smooth_mode = BoolSelector(false)  # "20.Custom Smooth Mode ?"; graph input
n10_custom_intersects_intersects = DoubleInput(4)  # "10.Custom Intersects : Intersects : U"; graph input
n11_custom_intersects_intersects = DoubleInput(4)  # "11.Custom Intersects : Intersects : V"; graph input
n01_export_to_sat = BoolSelector(false)  # "01.Export To SAT ?"; graph input
n18_custom_offsets_profiles = DoubleInput(0)  # "18.Custom Offsets : Profiles Offset Copy"; graph input
n19_custom_offsets_guides_offset = DoubleInput(0)  # "19.Custom Offsets : Guides Offset"; graph input
n21_custom_smooth_mode_smooth = BoolSelector(false)  # "21.Custom Smooth Mode : Smooth Mode - Profiles ?"; graph input
n22_custom_smooth_mode_smooth = BoolSelector(false)  # "22.Custom Smooth Mode : Smooth Mode : Force Smooth Closed Loops - Profiles"; graph input
n23_custom_smooth_mode_smooth = DoubleInput(10)  # "23.Custom Smooth Mode : Smooth Mode : Points Distancing - Profiles"; graph input
n24_custom_smooth_mode_smooth = BoolSelector(false)  # "24.Custom Smooth Mode : Smooth Mode - Guides ?"; graph input
n25_custom_smooth_mode_smooth = BoolSelector(false)  # "25.Custom Smooth Mode : Smooth Mode : Force Smooth Closed Loops - Guides"; graph input
n26_custom_smooth_mode_smooth = DoubleInput(10)  # "26.Custom Smooth Mode : Smooth Mode : Points Distancing - Guides"; graph input
n12_custom_intersects_intersects = DoubleInput(3)  # "12.Custom Intersects : Intersects : Number of Control Points Per Intersecting Line"; graph input
n13_custom_intersects_intersects = DoubleInput(1)  # "13.Custom Intersects : Intersects : Extend Distance"; graph input
n14_custom_intersects_intersects = StringInput("Dynamo Reference Planes")  # "14.Custom Intersects : Intersects : Reference Planes Name Pre-Fix"; graph input
n15_custom_intersects_intersects = DoubleInput(5)  # "15.Custom Intersects : Intersects : Reference Planes Offset From Face"; graph input
n16_custom_intersects_intersects = BoolSelector(false)  # "16.Custom Intersects : Intersects : Flip Reference Planes Side ?"; graph input
n02_sat_export_path = StringInput("D:\Exported Loft.sat")  # "02.SAT Export Path"; graph input
n17_custom_offsets = BoolSelector(false)  # "17.Custom Offsets ?"; graph input
n09_custom_intersects_draw = BoolSelector(false)  # "09.Custom Intersects : Draw Intersects ?"; graph input
n08_custom_intersects = BoolSelector(false)  # "08.Custom Intersects ?"; graph input
n05_custom_guides_behaviour = BoolSelector(false)  # "05.Custom Guides Behaviour ?"; graph input
n06_custom_guides_behaviour = BoolSelector(false)  # "06.Custom Guides Behaviour : Guides As Rails ?"; graph input
n07_custom_guides_behaviour_loop = BoolSelector(false)  # "07.Custom Guides Behaviour : Loop Mode ?"; graph input
n03_custom_family_template = BoolSelector(false)  # "03.Custom Family Template ?"; graph input
n04_custom_family_template_family = Filename("..\..\..\..\..\..\..\..\Desktop\Family toolkit\Conceptual\K-Conceptual Mass.rft")  # "04.Custom Family Template : Family Template of The Used Category"; graph input

custom_family_method_false = BoolSelector(false)  # "Custom Family Method : False = Imported Object | True = Family"
uv_management_loft_updater = Custom[UV Management Loft - Updater](VARCustomSmoothMode=n20_custom_smooth_mode, VARCustomIntersectsU=n10_custom_intersects_intersects, VARCustomIntersectsV=n11_custom_intersects_intersects, VARExportToSAT=n01_export_to_sat, VARCustomOffsetsProfilesOffsetCopy=n18_custom_offsets_profiles, VARCustomOffsetsGuidesOffset=n19_custom_offsets_guides_offset, VARCustomSmoothModeSmoothModeProfiles=n21_custom_smooth_mode_smooth, VARCustomSmoothModeSmoothModeForceSmoothClosedLoopsProfiles=n22_custom_smooth_mode_smooth, VARCustomSmoothModeSmoothModePointsDistancingProfiles=n23_custom_smooth_mode_smooth, VARCustomSmoothModeSmoothModeGuides=n24_custom_smooth_mode_smooth, VARCustomSmoothModeSmoothModeForceSmoothClosedLoopsGuides=n25_custom_smooth_mode_smooth, VARCustomSmoothModeSmoothModePointsDistancingGuides=n26_custom_smooth_mode_smooth, VARCustomIntersectsIntersectsNumberofControlPointsPerIntersectingLine=n12_custom_intersects_intersects, VARCustomIntersectsIntersectsExtendDistance=n13_custom_intersects_intersects, VARCustomIntersectsIntersectsReferencePlanesNamePreFix=n14_custom_intersects_intersects, VARCustomIntersectsIntersectsIntersectsReferencePlanesOffsetFromFace=n15_custom_intersects_intersects, VARCustomIntersectsIntersectsFlipReferencePlanesSide=n16_custom_intersects_intersects, VARSATExportPath=n02_sat_export_path, VARCustomOffsets=n17_custom_offsets, VARCustomIntersectsDrawIntersects=n09_custom_intersects_draw, VARCustomIntersects=n08_custom_intersects, VARCustomGuidesBehaviour=n05_custom_guides_behaviour, VARCustomGuidesBehaviourGuidesAsRail=n06_custom_guides_behaviour, VARCustomGuidesBehaviourLoopMode=n07_custom_guides_behaviour_loop, VARCustomFamilyTemplate=n03_custom_family_template, VARCustomFamilyTemplateFalseImportedObjectTrueFamily=custom_family_method_false, VARCustomFamilyTemplateFamilyTemplateofTheUsedCategory=n04_custom_family_template_family)  # package Synthesize toolkit; UV Management Loft - Updater
debug_python = Custom[Debug Python]()  # package Synthesize toolkit; Debug Python
