# Dynamo graph Conceptual.UV Management Loft Curves With Curves.dyn (Dynamo 2.13.1.3887)
# author: karam@aecedx.com
# packages: Synthesize toolkit 12.5.1

# group: Input
n08_smooth_mode_force_smooth = BoolSelector(false)  # "08.Smooth Mode : Force Smooth Closed Loops - Profiles"; graph input
n09_smooth_mode_points_distancing = DoubleInput(10)  # "09.Smooth Mode : Points Distancing - Profiles"; graph input
n07_smooth_mode_profiles = BoolSelector(false)  # "07.Smooth Mode - Profiles ?"; graph input
n06_loop_mode = BoolSelector(false)  # "06.Loop Mode"; graph input
n05_guides_as_rails = BoolSelector(false)  # "05.Guides As Rails ?"; graph input
n02_profiles_offset_copy = DoubleInput(0)  # "02.Profiles Offset Copy"; graph input
n01_select_curve_profile_s = DSModelElementsSelection()  # "01.Select Curve Profile(s)"; nothing selected; graph input
n11_smooth_mode_force_smooth = BoolSelector(false)  # "11.Smooth Mode : Force Smooth Closed Loops - Guides"; graph input
n12_smooth_mode_points_distancing = DoubleInput(10)  # "12.Smooth Mode : Points Distancing - Guides"; graph input
n10_smooth_mode_guides = BoolSelector(false)  # "10.Smooth Mode - Guides ?"; graph input
n03_select_curve_guide_s = DSModelElementsSelection()  # "03.Select Curve Guide(s)"; nothing selected; graph input
n13_import_to_revit = BoolSelector(true)  # "13.Import To Revit ?"; graph input
n25_draw_intersects = BoolSelector(false)  # "25.Draw Intersects ?"; graph input
n26_intersects_u = DoubleInput(10)  # "26.Intersects : U"; graph input
n27_intersects_v = DoubleInput(10)  # "27.Intersects : V"; graph input
n28_intersects_number_of_control = DoubleInput(3)  # "28.Intersects : Number of Control Points Per Intersecting Line"; graph input
n29_intersects_extend_distance = DoubleInput(1)  # "29.Intersects : Extend Distance"; graph input
n31_intersects_reference_planes = DoubleInput(5)  # "31.Intersects : Reference Planes Offset From Face"; graph input
n30_intersects_reference_planes = StringInput("Dynamo Reference Planes")  # "30.Intersects : Reference Planes Name Pre-Fix"; graph input
n32_intersects_flip_reference = BoolSelector(false)  # "32.Intersects : Flip Reference Planes Side ?"; graph input
n18_family_method_family_name = StringInput("Dynamo Loft Family")  # "18.Family Method : Family Name"; graph input
n20_family_method_start_sequence = DoubleInput(1)  # "20.Family Method : Start Sequence (Naming Suffix) - Manual Mode"; graph input
n22_family_method_category = Categories("OST_Mass")  # "22.Family Method : Category"; graph input
n14_method_false_imported_object = BoolSelector(true)  # "14.Method : False = Imported Object | True = Family"; graph input
n24_family_method_family_template = Filename("..\..\..\..\..\..\..\..\..\..\ProgramData\Autodesk\RVT 2020\Family Templates\English\Conceptual Mass\Metric Mass.rft")  # "24.Family Method : Family Template of The Above Category"; graph input
n17_family_method_to_void = BoolSelector(false)  # "17.Family Method : To Void ?"; graph input
n15_family_method_1_family_only = BoolSelector(false)  # "15.Family Method : 1 Family Only ? (False = Family For Each Solid/Surface)"; graph input
n16_family_method_is_shared = BoolSelector(false)  # "16.Family Method : Is Shared Family ?"; graph input
n33_export_to_sat = BoolSelector(false)  # "33.Export To SAT ?"; graph input
n34_sat_export_path = StringInput("D:\Exported Loft.sat")  # "34.SAT Export Path"; graph input
n04_guides_offset = DoubleInput(0)  # "04.Guides Offset"; graph input
n21_family_method_material = StringInput("")  # "21.Family Method : Material"; graph input
n23_family_method_subcategory = StringInput("")  # "23.Family Method : Subcategory"; graph input
n19_family_method_sequence_naming = BoolSelector(true)  # "19.Family Method : Sequence Naming Mode : True = Auto | False = Manual"; graph input

geometry_of_model_curves_and = Custom[Geometry of Model Curves and Curve By Points](VARElements=n01_select_curve_profile_s)  # package Synthesize toolkit; Geometry and Vector of Model Curves and Curve By Points
geometry_of_model_curves_and_2 = Custom[Geometry of Model Curves and Curve By Points](VARElements=n03_select_curve_guide_s)
smart_rft_path = Custom[Smart RFT Path](VARRFTFile=n24_family_method_family_template, VARCategory=n22_family_method_category)  # package Synthesize toolkit; Smart RFT Path
family_method_place_instance = BoolSelector(false)  # "Family Method : Place Instance Even If Already Placed ?"
family_method_positioning_system = BoolSelector(true)  # "Family Method : Positioning System : False = Instance Origin | True = Relative To Project Origin"
family_method_update_family_even = BoolSelector(true)  # "Family Method : Update Family Even If Already Exists ?"
uv_management_loft = Custom[UV Management Loft](VARForceCloseProfiles=n08_smooth_mode_force_smooth, VARPointsDistanceProfiles=n09_smooth_mode_points_distancing, VARSmoothModeProfiles=n07_smooth_mode_profiles, VARLoopMode=n06_loop_mode, VARGuidesasRails=n05_guides_as_rails, VAROffsetProfiles=n02_profiles_offset_copy, VARProfiles=geometry_of_model_curves_and, VARForceCloseGuides=n11_smooth_mode_force_smooth, VARPointsDistanceGuides=n12_smooth_mode_points_distancing, VARSmoothModeGuides=n10_smooth_mode_guides, VARGuides=geometry_of_model_curves_and_2, VARImportToRevit=n13_import_to_revit, VARDrawIntersects=n25_draw_intersects, VARU=n26_intersects_u, VARV=n27_intersects_v, VARNumberofControlPointsPerLine=n28_intersects_number_of_control, VARExtraExtendedDistance=n29_intersects_extend_distance, VARReferencePlanesOffset=n31_intersects_reference_planes, VARReferencePlaneNamePrefix=n30_intersects_reference_planes, VARFlipReferencePlanesSide=n32_intersects_flip_reference, VARFamilyName=n18_family_method_family_name, VARStartSequenceNamingSuffix=n20_family_method_start_sequence, VARFamilyCategory=n22_family_method_category, VARMethodFalseIsImportedObjectTrueIsFamily=n14_method_false_imported_object, VARFamilyTemplate=smart_rft_path, VARIsVoid=n17_family_method_to_void, VAROneFamily=n15_family_method_1_family_only, VARisShared=n16_family_method_is_shared, VARExportSAT=n33_export_to_sat, VARSATFilepath=n34_sat_export_path, VAROffsetGuides=n04_guides_offset, VARPlaceInstaceEvenIfAlreadyPlaced=family_method_place_instance, VARPositionSystemFalseIsInstanceOriginTrueIsRelativeToProjectOrigin=family_method_positioning_system, VARmaterialName=n21_family_method_material, VARsubcategoryName=n23_family_method_subcategory, VARUpdateFamilyEvenIfAlreadyExists=family_method_update_family_even, VARAutoSequenceNamingSuffix=n19_family_method_sequence_naming)  # package Synthesize toolkit; UV Management Loft

# group: Result
n01_revit_import_report = Watch(uv_management_loft.VARRevitImportReport)  # "01.Revit Import Report"; graph output

uv_management_intersects = Custom[UV Management Intersects Function](VARElements=uv_management_loft.VARToIntesectElements, VARIntersects=uv_management_loft.VARToIntesectLines, VARDrawIntersectsToggle=n25_draw_intersects)  # package Synthesize toolkit; UV Management Intersects Function
code_block = CodeBlock { false; }
python_script = Python(IN[0]=n02_profiles_offset_copy, IN[1]=n04_guides_offset, IN[2]=n05_guides_as_rails, IN[3]=n06_loop_mode, IN[4]=n07_smooth_mode_profiles, IN[5]=n08_smooth_mode_force_smooth, IN[6]=n09_smooth_mode_points_distancing, IN[7]=n10_smooth_mode_guides, IN[8]=n11_smooth_mode_force_smooth, IN[9]=n12_smooth_mode_points_distancing, IN[10]=n13_import_to_revit, IN[11]=n14_method_false_imported_object, IN[12]=family_method_update_family_even, IN[13]=family_method_place_instance, IN[14]=family_method_positioning_system, IN[15]=n15_family_method_1_family_only, IN[16]=n16_family_method_is_shared, IN[17]=n17_family_method_to_void, IN[18]=n18_family_method_family_name, IN[19]=code_block, IN[20]=uv_management_loft.VARStartSequenceNamingSuffix, IN[21]=n21_family_method_material, IN[22]=n22_family_method_category, IN[23]=n23_family_method_subcategory, IN[24]=smart_rft_path, IN[25]=n25_draw_intersects, IN[26]=n26_intersects_u, IN[27]=n27_intersects_v, IN[28]=n28_intersects_number_of_control, IN[29]=n29_intersects_extend_distance, IN[30]=n30_intersects_reference_planes, IN[31]=n31_intersects_reference_planes, IN[32]=n32_intersects_flip_reference, IN[33]=n33_export_to_sat, IN[34]=n34_sat_export_path, IN[35]=uv_management_loft.VARRElements, IN[36]=n01_select_curve_profile_s, IN[37]=n03_select_curve_guide_s)  # IronPython2
# ---------- python_script.python (264 lines) ----------
# Enable Python support and load DesignScript library
# IMPORTANT : ALL DYNAMO DESIGN SCRIPT NODES ARE AS (dg)
import clr
clr.AddReference('ProtoGeometry')
from Autodesk.DesignScript import Geometry as dg

# EXTENSION Enable ToDSType
clr.AddReference('RevitNodes')
import Revit
clr.ImportExtensions(Revit.Elements)

# Enable Revit Elements
from Revit.Elements import *

# EXTENSION Enable Geometry Conversion Methods
clr.ImportExtensions(Revit.GeometryConversion)

# Enable Revit API
clr.AddReference('RevitAPI')
from Autodesk.Revit.DB import *

# Enable DocumentManager and TransactionManager
clr.AddReference('RevitServices')
from RevitServices.Persistence import DocumentManager
from RevitServices.Transactions import TransactionManager

# Enable ICollection List Translate
clr.AddReference("System")
import System.Collections.Generic
from System.Collections.Generic import List

def tolist(obj1):
	if hasattr(obj1,'__iter__'): return obj1
	else: return [obj1]

# Choose The Current Document
doc = DocumentManager.Instance.CurrentDBDocument
uidoc = DocumentManager.Instance.CurrentUIApplication.ActiveUIDocument
uiapp = DocumentManager.Instance.CurrentUIApplication
app = uiapp.Application

dataEnteringNode = IN
# Use UnwrapElement(IN[0]) When Translating From Dynamo to Revit

par0 = UnwrapElement(IN[0])
par1 = UnwrapElement(IN[1])
par2 = UnwrapElement(IN[2])
par3 = UnwrapElement(IN[3])
par4 = UnwrapElement(IN[4])
par5 = UnwrapElement(IN[5])
par6 = UnwrapElement(IN[6])
par7 = UnwrapElement(IN[7])
par8 = UnwrapElement(IN[8])
par9 = UnwrapElement(IN[9])
par10 = UnwrapElement(IN[10])
par11 = UnwrapElement(IN[11])
par12 = UnwrapElement(IN[12])
par13 = UnwrapElement(IN[13])
par14 = UnwrapElement(IN[14])
par15 = UnwrapElement(IN[15])
par16 = UnwrapElement(IN[16])
par17 = UnwrapElement(IN[17])
par18 = UnwrapElement(IN[18])
par19 = UnwrapElement(IN[19])
par20 = UnwrapElement(IN[20])
par21 = UnwrapElement(IN[21])
par22 = UnwrapElement(IN[22])
par23 = UnwrapElement(IN[23])
par24 = UnwrapElement(IN[24])
par25 = UnwrapElement(IN[25])
par26 = UnwrapElement(IN[26])
par27 = UnwrapElement(IN[27])
par28 = UnwrapElement(IN[28])
par29 = UnwrapElement(IN[29])
par30 = UnwrapElement(IN[30])
par31 = UnwrapElement(IN[31])
par32 = UnwrapElement(IN[32])
par33 = UnwrapElement(IN[33])
par34 = UnwrapElement(IN[34])
par35 = UnwrapElement(IN[35])

par22 = par22.Name

elems = par35

false = False
true = True

if par2 == false:
	par2 = "f"
elif par2 == true:
	par2= "t"

if par3 == false:
	par3 = "f"
elif par3 == true:
	par3= "t"

if par4 == false:
	par4 = "f"
elif par4 == true:
	par4= "t"
	
if par5 == false:
	par5 = "f"
elif par5 == true:
	par5 = "t"
	
if par7 == false:
	par7 = "f"
elif par7 == true:
	par7 = "t"
	
if par8 == false:
	par8 = "f"
elif par8 == true:
	par8 = "t"	
	
if par10 == false:
	par10 = "f"
elif par10 == true:
	par10 = "t"	
	
if par11 == false:
	par11 = "f"
elif par11 == true:
	par11= "t"
	
if par12 == false:
	par12 = "f"
elif par12 == true:
	par12 = "t"	

if par13 == false:
	par13 = "f"
elif par13 == true:
	par13= "t"
	
if par14 == false:
	par14 = "f"
elif par14 == true:
	par14= "t"

if par15 == false:
	par15 = "f"
elif par15 == true:
	par15 = "t"
	
if par16 == false:
	par16 = "f"
elif par16 == true:
	par16 = "t"

if par17 == false:
	par17 = "f"
elif par17 == true:
	par17 = "t"
		
if par19 == false:
	par19 = "f"
elif par19 == true:
	par19 = "t"

if par25 == false:
	par25 = "f"
elif par25 == true:
	par25 = "t"

if par32 == false:
	par32 = "f"
elif par32 == true:
	par32 = "t"

if par33 == false:
	par33 = "f"
elif par33 == true:
	par33 = "t"

if par21 == "":
	par21 = " "

if par23 == "":
	par23 = " "

par24 = par24.replace(":","X1" )
par24 = par24.replace("\\","X2" )

par34 = par34.replace(":","X1" )
par34 = par34.replace("\\","X2" )

# Create Empty List
result = []

tmplist = []
for each in elems:
	tmplist.append(str(each.Id))
joined = "-".join(tmplist)

#collect all views in the model
collector = FilteredElementCollector(doc)
filters = collector.OfClass(FilterElement).ToElements()
fnames = []
acceptedfilters = []
for each in filters:
	if each.ToString() == "Autodesk.Revit.DB.SelectionFilterElement":
		if each.IsEmpty() == False and "DONOTDELETE-Dynamo UV Management" in each.Name:
			fnames.append(each.Name)
			acceptedfilters.append(each)

if len(fnames) != 0:
	sequences = []
	for each in fnames:
		split = each.split(",")
		sequences.append(int(split[1]))
	uniqueseq = sorted(list(set(sequences)))
	lastseq = uniqueseq[-1] + 1
else:
	lastseq = 1

result = [str(par0)] + [str(par1)] + [par2] + [par3] + [par4] + [par5] + [str(par6)] + [par7] + [par8] + [str(par9)] + [par10] + [par11 ]+ [par12] + [par13] + [par14] + [par15] + [par16] + [par17] + [par18] + [par19] + [str(par20)] + [par21] + [par22] + [par23] + [par24] + [par25] + [str(par26)] + [str(par27)] + [str(par28)] + [str(par29)] + [par30] + [str(par31)] + [par32] + [par33] + [par34] + [joined]

joinedresult = ",".join(result)

filter1name = "DONOTDELETE-Dynamo UV Management Loft Profiles," + str(lastseq) + "," + joinedresult
filter2name = "DONOTDELETE-Dynamo UV Management Loft Guides," + str(lastseq) + "," + joinedresult

profs = UnwrapElement(IN[36])
guides = UnwrapElement(IN[37])

profs = tolist(profs)
guides = tolist(guides)

profset = []
# create itemset
ids = list()
for item in profs:
	ids.append(item.Id)
profset = List[ElementId](ids)

guideset = []
# create itemset
ids = list()
for item in guides:
	ids.append(item.Id)
guideset = List[ElementId](ids)

TransactionManager.Instance.EnsureInTransaction(doc)
selset1 = SelectionFilterElement.Create(doc,filter1name)
selset2 = SelectionFilterElement.Create(doc,filter2name)
# add the items to the selection set
selset1.AddSet(profset)
selset2.AddSet(guideset)

for each in elems:
	currentparams = "Comments"
	eachparams = each.GetOrderedParameters()
	for e in eachparams:
		pname = e.Definition.Name.lower()
		if pname == currentparams.lower():
			e.Set(joined)

TransactionManager.Instance.TransactionTaskDone()

OUT = selset1.ToDSType(False), selset2.ToDSType(False)
# ----------------------------------------
debug_python = Custom[Debug Python]()  # package Synthesize toolkit; Debug Python
