# Dynamo graph Coordination.Place Coordination Family By Selection Filter.dyn (Dynamo 2.13.1.3887)
# author: karam@aecedx.com
# packages: Synthesize toolkit 12.5.1

hot_get_all_filter = Custom[HOT.Get All Filter]()  # package Synthesize toolkit; Get all Filter
toLower = String.ToLower(string=hot_get_all_filter.VARName)
trimWhitespace = String.TrimWhitespace(string=toLower)

# group: Input
n01_selection_filter_to_read = StringInput("Fitler Name")  # "01.Selection Filter to Read"; graph input
n03_coordination_family_to_place = FamilyTypes("Sample K-Coordinator:Sample K-Coordinator")  # "03.Coordination Family To Place"; graph input
n06_family_info_parameter = StringInput("Family Info")  # "06.Family Info Parameter"; graph input
n02_delete_unused_coordination = BoolSelector(true)  # "02.Delete Unused Coordination Families"; graph input
n04_internal_origin_1_project = IntegerSlider(1, range=1..3 step 1)  # "04.Internal Origin = 1 | Project Base Point = 2 | Survey Point = 3"; graph input
rounding = DoubleInput(0.001)  # "10.Rounding"; graph input
n12_time_parameter = StringInput("Time Updated")  # "12.Time Parameter"; graph input
n11_point_reference_parameter = StringInput("Point Reference")  # "11.Point Reference Parameter (Internal | Base Point | Survey)"; graph input
n09_z_point_parameter = StringInput("Z")  # "09.Z Point Parameter"; graph input
n08_y_point_parameter = StringInput("Y")  # "08.Y Point Parameter"; graph input
n07_x_point_parameter = StringInput("X")  # "07.X Point Parameter"; graph input
n05_document_parameter = StringInput("Document")  # "05.Document Parameter"; graph input

toLower_2 = String.ToLower(string=n01_selection_filter_to_read)
trimWhitespace_2 = String.TrimWhitespace(string=toLower_2)
eq = trimWhitespace == trimWhitespace_2
filterByBoolMask = List.FilterByBoolMask(list=hot_get_all_filter.VARElement, mask=eq)
elements = Custom[CW.SelectionSet.Elements](VARselectionSet=filterByBoolMask.in)  # package Synthesize toolkit; Retrieves all elements stored in a selection set
flatten = List.Flatten(list=elements)
coordination_family_management = Custom[Coordination Family Management](VARElementsToPlaceCoordination=flatten, VARFamilyType=n03_coordination_family_to_place, VARFamilyInfoParameterName=n06_family_info_parameter, VARDeleteUnusedCoordinationFamily=n02_delete_unused_coordination, VARInternalOriginIs1ProjectBasePointIs2SurveyPointIs3=n04_internal_origin_1_project, VARprecision=rounding, VARTimeParameter=n12_time_parameter, VARPointReferenceParameter=n11_point_reference_parameter, VARYParameter=n09_z_point_parameter, VARZParameter=n08_y_point_parameter, VARXParameter=n07_x_point_parameter, VARDocumentParameter=n05_document_parameter)  # package Synthesize toolkit; Coordination Management
debug_python = Custom[Debug Python]()  # package Synthesize toolkit; Debug Python
