# Dynamo graph Debug.Files Copy.dyn (Dynamo 2.13.1.3887)
# author: karam@aecedx.com
# packages: Synthesize toolkit 12.5.1

# group: Input
n05_proceed_with_copy = BoolSelector(false)  # "05.Proceed with Copy"; graph input
n02_directory_path = Directory("D:\Production")  # "02.Directory Path"; graph input
n03_string_to_search_for = StringInput("_Compressed")  # "03.String to search for"; graph input
n04_destination_path = StringInput("D:\PURECOPY\")  # "04.Destination Path"; graph input

contentsAll = Custom[CW.Directory.ContentsAll](VARdirectoryPath=n02_directory_path)  # package Synthesize toolkit; Unlike the built-in node Directory.Contents, this node browses a directory recursively and returns all relevant files contained in subfolders as well.
code_block = CodeBlock { false; }
countOccurrences = String.CountOccurrences(string=contentsAll, searchFor=n03_string_to_search_for, ignoreCase=code_block)
code_block_2 = CodeBlock { 0; }
gt = countOccurrences > code_block_2
filterByBoolMask = List.FilterByBoolMask(list=contentsAll, mask=gt)

# group: Result
files = Watch(filterByBoolMask.in)  # "01.Files"; graph output

string = StringInput("\")  # "01.String"; graph input
split = String.Split(string=files, separator0=string)
lastItem = List.LastItem(list=split@L2)
al_duplicate_item_indices = Custom[AL.Duplicate Item Indices](VARList=lastItem)  # package Synthesize toolkit; Searches an input list for duplicate entries and lists their index numbers. Couple with Get From List to delete duplicates from a list.
removeItemAtIndex = List.RemoveItemAtIndex(list=files, indices=al_duplicate_item_indices.VARDuplicateIndices)
fromPath = FileObject(path=removeItemAtIndex)  # "File.FromPath"
empty = List.Empty()
scopeIf = Custom[CW.ScopeIf+](VARtest=n05_proceed_with_copy, VARtrue=fromPath, VARfalse=empty)  # package Synthesize toolkit; A (hopefully) more robust implementation of ScopeIf. Tests a single boolean and returns a value accordingly.
removeItemAtIndex_2 = List.RemoveItemAtIndex(list=lastItem, indices=al_duplicate_item_indices.VARDuplicateIndices)
code_block_3 = CodeBlock(a=n04_destination_path, b=removeItemAtIndex_2) { a+b; }
scopeIf_2 = Custom[CW.ScopeIf+](VARtest=n05_proceed_with_copy, VARtrue=code_block_3, VARfalse=empty)
code_block_4 = CodeBlock { false; }
copyFile = FileSystem.CopyFile(file=scopeIf, destinationPath=scopeIf_2, overwrite=code_block_4, lacing=Longest)
debug_python = Custom[Debug Python]()  # package Synthesize toolkit; Debug Python
