# Dynamo graph Debug.Fix Input Names.dyn (Dynamo 2.13.1.3887)
# author: karam@aecedx.com
# packages: Synthesize toolkit 12.5.1

n02_directory_path = Directory("C:\Users\karam\AppData\Roaming\Dynamo\Dynamo Revit\1.3\packages\Synthesize toolkit\dyf")  # "02.Directory Path"; graph input
contentsAll = Custom[CW.Directory.ContentsAll](VARdirectoryPath=n02_directory_path)  # package Synthesize toolkit; Unlike the built-in node Directory.Contents, this node browses a directory recursively and returns all relevant files contained in subfolders as well.
readText = FileSystem.ReadText(file=contentsAll)
n01_node_to_search_for = StringInput("<Symbol value=\"")  # "01.Node to Search for"; graph input
split = String.Split(string=readText, separator0=n01_node_to_search_for)
code_block = CodeBlock { 0; }
getItemAtIndex = List.GetItemAtIndex(list=split@L2, index=code_block)
code_block_2 = CodeBlock { 1; }
dropItems = List.DropItems(list=split@L2, amount=code_block_2)
string = StringInput(" />")  # "03.String"; graph input
split_2 = String.Split(string=dropItems, separator0=string)
code_block_3 = CodeBlock(a=split_2, b=string) { a+b; }
code_block_4 = CodeBlock { 0; }
getItemAtIndex_2 = List.GetItemAtIndex(list=split_2@@L2, index=code_block_4)
code_block_5 = CodeBlock()
# ---------- code_block_5.designscript (26 lines) ----------
"1.0e-9";
"10e9";

".rft";
"rft";

"Filter.ID";
"FilterID";

"Dynamo.Color";
"DynamoColor";

"Revit.Color";
"RevitColor";

"Active.View";
"ActiveView";

"Override.Setting";
"OverrideSetting";

".html";
"html";

"No.of Digits";
"Noof Digits";
# ----------------------------------------
code_block_6 = CodeBlock { ""; }
replace = String.Replace(string=getItemAtIndex_2, searchFor=code_block_5.out0, replaceWith=code_block_6)
replace_2 = String.Replace(string=replace, searchFor=code_block_5.out1, replaceWith=code_block_6)
replace_3 = String.Replace(string=replace_2, searchFor=code_block_5.out2, replaceWith=code_block_6)
replace_4 = String.Replace(string=replace_3, searchFor=code_block_5.out3, replaceWith=code_block_6)
replace_5 = String.Replace(string=replace_4, searchFor=code_block_5.out4, replaceWith=code_block_6)
replace_6 = String.Replace(string=replace_5, searchFor=code_block_5.out5, replaceWith=code_block_6)
replace_7 = String.Replace(string=replace_6, searchFor=code_block_5.out6, replaceWith=code_block_6)
replace_8 = String.Replace(string=replace_7, searchFor=code_block_5.out7, replaceWith=code_block_6)
replace_9 = String.Replace(string=replace_8, searchFor=code_block_5.out8, replaceWith=code_block_6)
replace_10 = String.Replace(string=replace_9, searchFor=code_block_5.out9, replaceWith=code_block_6)
replace_11 = String.Replace(string=replace_10, searchFor=code_block_5.out10, replaceWith=code_block_6)
replace_12 = String.Replace(string=replace_11, searchFor=code_block_5.out11, replaceWith=code_block_6)
replace_13 = String.Replace(string=replace_12, searchFor=code_block_5.out12, replaceWith=code_block_6)
replace_14 = String.Replace(string=replace_13, searchFor=code_block_5.out13, replaceWith=code_block_6)
replace_15 = String.Replace(string=replace_14, searchFor=code_block_5.out14, replaceWith=code_block_6)
replace_16 = String.Replace(string=replace_15, searchFor=code_block_5.out15, replaceWith=code_block_6)
replace_17 = String.Replace(string=replace_16, searchFor=code_block_5.out16, replaceWith=code_block_6)
replace_18 = String.Replace(string=replace_17, searchFor=code_block_5.out17, replaceWith=code_block_6)
string_2 = StringInput("'")  # "09.String"; graph input
replace_19 = String.Replace(string=replace_18, searchFor=string_2, replaceWith=code_block_6)
code_block_7 = CodeBlock { " "; "("; ")"; "|"; ","; "."; "?"; "&"; "-"; }
replace_20 = String.Replace(string=replace_19, searchFor=code_block_7.out0, replaceWith=code_block_6)
replace_21 = String.Replace(string=replace_20, searchFor=code_block_7.out1, replaceWith=code_block_6)
replace_22 = String.Replace(string=replace_21, searchFor=code_block_7.out2, replaceWith=code_block_6)
replace_23 = String.Replace(string=replace_22, searchFor=code_block_7.out3, replaceWith=code_block_6)
replace_24 = String.Replace(string=replace_23, searchFor=code_block_7.out4, replaceWith=code_block_6)
string_3 = StringInput("var[]..[]")  # "05.String"; graph input
code_block_8 = CodeBlock { "JKARAMJ"; }
replace_25 = String.Replace(string=replace_24, searchFor=string_3, replaceWith=code_block_8)
replace_26 = String.Replace(string=replace_25, searchFor=code_block_8, replaceWith=string_3)
replace_27 = String.Replace(string=replace_26, searchFor=code_block_7.out6, replaceWith=code_block_6)
code_block_9 = CodeBlock { "&#"; "XKARAMX"; }
replace_28 = String.Replace(string=replace_27, searchFor=code_block_9.out0, replaceWith=code_block_9.out1)
string_4 = StringInput("&quot;")  # "04.String"; graph input
code_block_10 = CodeBlock { "YKARAMY"; }
replace_29 = String.Replace(string=replace_28, searchFor=string_4, replaceWith=code_block_10)
replace_30 = String.Replace(string=replace_29, searchFor=code_block_7.out7, replaceWith=code_block_6)
string_5 = StringInput("#")  # "08.String"; graph input
replace_31 = String.Replace(string=replace_30, searchFor=string_5, replaceWith=code_block_6)
replace_32 = String.Replace(string=replace_31, searchFor=code_block_9.out1, replaceWith=code_block_9.out0)
replace_33 = String.Replace(string=replace_32, searchFor=code_block_10, replaceWith=string_4)
code_block_11 = CodeBlock { 0; }
code_block_12 = CodeBlock { "VAR"; "VAR//"; "//"; }
insert = String.Insert(string=replace_33, index=code_block_11, toInsert=code_block_12.out0)
replace_34 = String.Replace(string=insert, searchFor=code_block_12.out1, replaceWith=code_block_12.out2)
replace_35 = String.Replace(string=replace_34, searchFor=code_block_7.out8, replaceWith=code_block_6)
string_6 = StringInput(":2")  # "06.String"; graph input
string_7 = StringInput(":N2")  # "07.String"; graph input
replace_36 = String.Replace(string=replace_35, searchFor=string_6, replaceWith=string_7)
code_block_13 = CodeBlock { "//"; "TKARAMT"; }
replace_37 = String.Replace(string=replace_36, searchFor=code_block_13.out0, replaceWith=code_block_13.out1)
code_block_14 = CodeBlock { "/"; }
replace_38 = String.Replace(string=replace_37, searchFor=code_block_14, replaceWith=code_block_6)
replace_39 = String.Replace(string=replace_38, searchFor=code_block_13.out1, replaceWith=code_block_13.out0)
code_block_15 = CodeBlock()
# ---------- code_block_15.designscript (47 lines) ----------
"TSplineSurface1";
"TSplineSurface";

"TSplineSurface2";
"TSplineSurface";

"od:False";
"odFalse";

"ance:StartOffset";
"anceStartOffset";

"ance:Distances";
"anceDistances";

"er:Start";
"erStart";

"er:End";
"erEnd";

"ance:CenterJustification";
"anceCenterJustification";

"er:PositionJustification0to1";
"erPositionJustification0to1";

"er:NumberofItems";
"erNumberofItems";

"EX:N2";
"EX2";

"ance:Justify";
"anceJustify";

"ance:Force";
"anceForce";

"False=ImportedObjectTrue=Fam";
"FalseIsImportedObjectTrueIsFam";

"VARvar[]..[]";
"VAR:var[]..[]";

"set+Z";
"setZ";
# ----------------------------------------
replace_40 = String.Replace(string=replace_39, searchFor=code_block_15.out0, replaceWith=code_block_15.out1)
replace_41 = String.Replace(string=replace_40, searchFor=code_block_15.out2, replaceWith=code_block_15.out3)
replace_42 = String.Replace(string=replace_41, searchFor=code_block_15.out4, replaceWith=code_block_15.out5)
replace_43 = String.Replace(string=replace_42, searchFor=code_block_15.out6, replaceWith=code_block_15.out7)
replace_44 = String.Replace(string=replace_43, searchFor=code_block_15.out8, replaceWith=code_block_15.out9)
replace_45 = String.Replace(string=replace_44, searchFor=code_block_15.out10, replaceWith=code_block_15.out11)
replace_46 = String.Replace(string=replace_45, searchFor=code_block_15.out12, replaceWith=code_block_15.out13)
replace_47 = String.Replace(string=replace_46, searchFor=code_block_15.out14, replaceWith=code_block_15.out15)
replace_48 = String.Replace(string=replace_47, searchFor=code_block_15.out16, replaceWith=code_block_15.out17)
replace_49 = String.Replace(string=replace_48, searchFor=code_block_15.out18, replaceWith=code_block_15.out19)
replace_50 = String.Replace(string=replace_49, searchFor=code_block_15.out20, replaceWith=code_block_15.out21)
string_8 = StringInput("&quot;OST_GenericModel&quot;")  # "10.String"; graph input
string_9 = StringInput("(&quot;OST_GenericModel&quot;)")  # "11.String"; graph input
replace_51 = String.Replace(string=replace_50, searchFor=string_8, replaceWith=string_9)
replace_52 = String.Replace(string=replace_51, searchFor=code_block_15.out22, replaceWith=code_block_15.out23)
replace_53 = String.Replace(string=replace_52, searchFor=code_block_15.out24, replaceWith=code_block_15.out25)
replace_54 = String.Replace(string=replace_53, searchFor=code_block_15.out26, replaceWith=code_block_15.out27)
replace_55 = String.Replace(string=replace_54, searchFor=code_block_15.out28, replaceWith=code_block_15.out29)
replace_56 = String.Replace(string=replace_55, searchFor=code_block_15.out30, replaceWith=code_block_15.out31)
code_block_16 = CodeBlock(a=replace_56, b=string) { a+b; }
replaceItemAtIndex = List.ReplaceItemAtIndex(list=code_block_3@@L2, index=code_block_4, item=code_block_16@L1)
concat = String.Concat()  # unwired: string0
map = List.Map(list=replaceItemAtIndex, f_x=concat)
code_block_17 = CodeBlock(a=n01_node_to_search_for, b=map) { a+b; }
addItemToFront = List.AddItemToFront(item=getItemAtIndex, list=code_block_17@L2, lacing=Longest)
concat_2 = String.Concat()  # unwired: string0
map_2 = List.Map(list=addItemToFront, f_x=concat_2)
code_block_18 = CodeBlock { 3; }
removeFromEnd = Custom[RA.String.RemoveFromEnd](VARStr=map_2, VARNumberToRemove=code_block_18)  # package Synthesize toolkit; Remove characters from the end of a string by a given amount
writeText = FileSystem.WriteText(filePath=contentsAll, text=removeFromEnd)  # frozen
code_block_19 = CodeBlock { 1; }
flatten = List.Flatten(list=getItemAtIndex_2)  # frozen
uniqueItems = List.UniqueItems(list=flatten)
watch = Custom[SP.Watch+](VARinput=uniqueItems)  # package Synthesize toolkit; This node that serializes the input information and presents it in a resizable text window.
code_block_20 = CodeBlock { "VARcurves:AutodeskCurve[]"; }
countOccurrences = String.CountOccurrences(string=replace_56, searchFor=code_block_20)
code_block_21 = CodeBlock { 0; }
gt = countOccurrences > code_block_21
filterByBoolMask = List.FilterByBoolMask(list=replace_56, mask=gt)
watch_2 = 01.Watch(filterByBoolMask.in)  # graph output
isEmpty = List.IsEmpty(list=watch_2, lacing=Longest)
filterByBoolMask_2 = List.FilterByBoolMask(list=contentsAll, mask=isEmpty)
watch_3 = 02.Watch(filterByBoolMask_2.out)  # graph output
watch_4 = Custom[SP.Watch+](VARinput=replace_56)  # frozen
debug_python = Custom[Debug Python]()  # package Synthesize toolkit; Debug Python
