# Dynamo graph Detail.Range of Services Detection.dyn (Dynamo 2.13.1.3887)
# author: karam@aecedx.com
# packages: Synthesize toolkit 12.5.1

python_all_elements_in_active = Custom[Python All Elements In Active View]()  # package Synthesize toolkit; Python All Elements In Active View
code_block = CodeBlock { "FilledRegion"; }
byClassName = Custom[SP.Filter.ByClassName](VARobject=python_all_elements_in_active, VARclassName=code_block)  # package Synthesize toolkit; Filters a list of objects by the object's class name. Note that Dynamo elements belong to different classes than their Revit counterparts. Use the Object.Class node to check an object's class.

# group: Input
n02_radius_of_service_parameter = StringInput("RADIUS OF SERVICE")  # "02.Radius of Service Parameter"; graph input
n04_middle_point_parameter = StringInput("MID POINT DISTANCE")  # "04.Middle Point Parameter"; graph input
n01_select_land_outlines_detail = DSModelElementsSelection()  # "01.Select Land Outlines (Detail Lines or Model Lines)"; nothing selected; graph input
n03_nearest_point_parameter = StringInput("NEAREST POINT DISTANCE")  # "03.Nearest Point Parameter"; graph input
n05_furthest_point_parameter = StringInput("FURTHEST POINT DISTANCE")  # "05.Furthest Point Parameter"; graph input
n07_create_selection_filter_for = BoolSelector(true)  # "07.Create Selection Filter (For Lines)"; graph input
n08_selection_filter_name = StringInput("Dynamo Fun Lines")  # "08.Selection Filter Name"; graph input
n06_draw_lines_for_fun = BoolSelector(false)  # "06.Draw Lines (For Fun)"; graph input

parameterExists = Custom[CW.Element.ParameterExists](VARparam=n02_radius_of_service_parameter, VARelement=byClassName.VARin)  # package Synthesize toolkit; Checks if an element contains a parameter of a given name
filterByBoolMask = List.FilterByBoolMask(list=byClassName.VARin, mask=parameterExists)
curves = Element.Curves(element=n01_select_land_outlines_detail)
flatten = List.Flatten(list=curves)
as_polycurve_bycurves = Custom[AS.[&] PolyCurve.ByCurves](VARcurves=flatten)  # package Synthesize toolkit; Create polycurves from an unordered list of curves.
byOriginNormal = Plane.ByOriginNormal()
pullOntoPlane = Curve.PullOntoPlane(curve=as_polycurve_bycurves.VARpolyCurve, plane=byOriginNormal)
code_block_2 = CodeBlock { 5; }
unit_types = UnitTypes("Length")
displayUnitType = Custom[CW.UnitType.DisplayUnitType](VARunitType=unit_types)  # package Synthesize toolkit; Retrieves the display unit type for a given unit type.
toDisplayUnit = Custom[CW.InternalUnit.ToDisplayUnit](VARval=code_block_2, VARdisplayUnitType=displayUnitType.VARdisplayUnitType)  # package Synthesize toolkit; Converts a value from Revit's internal unit to a given display unit
lines_segmentation_by_distance = Custom[Lines Segmentation By Distance](VARCurves=pullOntoPlane, VARSegmentationDistance=toDisplayUnit)  # package Synthesize toolkit; Lines Segmentation By Distance
firstItem = List.FirstItem(list=lines_segmentation_by_distance)
curves_2 = PolyCurve.Curves(polyCurve=firstItem)
startPoint = Curve.StartPoint(curve=curves_2)
byPoints = Polygon.ByPoints(points=startPoint)
center = Polygon.Center(polygon=byPoints)
element_geometry_fixer_legacy = Custom[Element.Geometry Fixer Legacy](VARElements=filterByBoolMask.in)  # package Synthesize toolkit; Element.Geometry Fixer Legacy
code_block_3 = CodeBlock { "Surface"; }
byClassName_2 = Custom[SP.Filter.ByClassName](VARobject=element_geometry_fixer_legacy, VARclassName=code_block_3)
firstItem_2 = List.FirstItem(list=byClassName_2.VARin@L2)
byPatch = Surface.ByPatch(closedCurve=byPoints)
closestPointTo = Geometry.ClosestPointTo(geometry=firstItem_2, other=byPatch)
byStartPointEndPoint = Line.ByStartPointEndPoint(startPoint=center, endPoint=closestPointTo)

# group: Middle
length = Curve.Length(curve=byStartPointEndPoint)

setParameterByName = Element.SetParameterByName(element=filterByBoolMask.in, parameterName=n04_middle_point_parameter, value=length, lacing=Longest)
byStartPointEndPoint_2 = Line.ByStartPointEndPoint(startPoint=startPoint@L1, endPoint=closestPointTo)
transpose = List.Transpose(lists=byStartPointEndPoint_2)

# group: Minimum Distance
length_2 = Curve.Length(curve=transpose)
minimumItem = List.MinimumItem(list=length_2)
eq = length_2 == minimumItem
filterByBoolMask_2 = List.FilterByBoolMask(list=transpose, mask=eq)
flatten_2 = List.Flatten(list=filterByBoolMask_2.in)

# group: Nearest
length_3 = Curve.Length(curve=flatten_2)

setParameterByName_2 = Element.SetParameterByName(element=filterByBoolMask.in, parameterName=n03_nearest_point_parameter, value=length_3)

# group: Maximum Distance
length_4 = Curve.Length(curve=transpose)

maximumItem = List.MaximumItem(list=length_4)

# group (continued): Maximum Distance
eq_2 = length_4 == maximumItem
filterByBoolMask_3 = List.FilterByBoolMask(list=transpose, mask=eq_2)
flatten_3 = List.Flatten(list=filterByBoolMask_3.in)

# group: Furthest
length_5 = Curve.Length(curve=flatten_3)

setParameterByName_3 = Element.SetParameterByName(element=filterByBoolMask.in, parameterName=n05_furthest_point_parameter, value=length_5)
count = List.Count(list=filterByBoolMask.in)

# group: Report
n01_number_of_detected_filled = Watch(count)  # "01.Number of Detected Filled Regions"; graph output

code_block_4 = CodeBlock { false; }
create = List.Create(item0=flatten_2, item1=flatten_3, item2=byStartPointEndPoint)
code_block_5 = CodeBlock { false; }
clean = List.Clean(list=create, preserveIndices=code_block_5)
flatten_4 = List.Flatten(list=clean)
empty = List.Empty()
scopeIf = Custom[CW.ScopeIf+](VARtest=n06_draw_lines_for_fun, VARtrue=flatten_4, VARfalse=empty)  # package Synthesize toolkit; A (hopefully) more robust implementation of ScopeIf. Tests a single boolean and returns a value accordingly.
byCurve = ModelCurve.ByCurve(curve=scopeIf)
generate_selection_filter = Custom[Generate Selection Filter](VARCreateSelectionFilter=n07_create_selection_filter_for, VARFilterNametoCreate=n08_selection_filter_name, VAROverwriteExistingFilter=code_block_4, VARElements=byCurve)  # package Synthesize toolkit; Generate Selection FIlter
debug_python = Custom[Debug Python]()  # package Synthesize toolkit; Debug Python
