# Dynamo graph Dimensions.Faster Dimension By Centers.dyn (Dynamo 2.13.1.3887)
# author: karam@aecedx.com
# packages: Synthesize toolkit 12.5.1

hot_get_revit_activeview = Custom[HOT.Get Revit ActiveView]()  # package Synthesize toolkit; Active View
rh_pick_model_elements = Custom[RH.Pick Model Elements]()  # package Synthesize toolkit; This node offers a pick method for selecting elements in Revit.
n01_select_reference_line = DSModelElementSelection()  # "01.Select Reference Line"; nothing selected; graph input
geometry = Element.Geometry(element=n01_select_reference_line)
byElements = Dimension.ByElements(view=hot_get_revit_activeview, referenceElements=rh_pick_model_elements, line=geometry)
note = StringInput("Works with Line Drawn Based Families, Eg : Walls, Grids, Levels..etc")  # "02.Note"; graph input
debug_python = Custom[Debug Python]()  # package Synthesize toolkit; Debug Python
