# Dynamo graph Dimensions.Faster Dimension By Selected Faces (Private Locked By Karam).dyn (Dynamo 2.13.1.3887)
# author: karam@aecedx.com
# packages: Synthesize toolkit 12.5.1

# group: Input
n05_filter_elements_faces = StringInput("Wall")  # "05.Filter Elements Faces"; graph input
n02_select_faces_to_dimension = SelectFaces()  # "02.Select Faces to Dimension"; nothing selected; graph input
n04_method_1_vertical_faces_2 = IntegerSlider(1, range=1..4 step 1)  # "04.Method (1 = Vertical Faces | 2 = Horizontal Up Faces | 3 = Horizontal Down Faces | 4 = All Faces)"; graph input
n08_proceed = BoolSelector(false)  # "08.Proceed ?"; graph input
n03_select_first_face = DSFaceSelection()  # "03.Select First Face"; nothing selected; graph input
n01_select_reference_line = DSModelElementSelection()  # "01.Select Reference Line"; nothing selected; graph input
n06_split_dimensions = BoolSelector(false)  # "06.Split Dimensions ?"; graph input
n07_shift_dimensions_pairs = BoolSelector(false)  # "07.Shift Dimensions Pairs ?"; graph input

area = Surface.Area(surface=n02_select_faces_to_dimension)
maximumItem = List.MaximumItem(list=area)
eq = area == maximumItem
filterByBoolMask = List.FilterByBoolMask(list=n02_select_faces_to_dimension, mask=eq)
faster_dimensions_faces_helper = Custom[Faster Dimensions Faces Helper](Filter_Elements=n05_filter_elements_faces, Surfaces=filterByBoolMask.in, Method_1_Vertical_Faces_2_Horizontal_Up_Faces_3_Horizontal_Down_Faces_4_All_Faces=n04_method_1_vertical_faces_2, Proceed=n08_proceed, First_Face=n03_select_first_face)

# group: Result
n01_faces_of_elements_to_filter = Watch(faster_dimensions_faces_helper.Faces_of_Elements_To_Filter_Through)  # "01.Faces of Elements To Filter Through"; graph output

code_block = CodeBlock { 1; }
shiftIndices = List.ShiftIndices(list=faster_dimensions_faces_helper.Revit_Faces, amount=code_block)
scopeIf = Custom[CW.ScopeIf+](VARtest=n07_shift_dimensions_pairs, VARtrue=shiftIndices, VARfalse=faster_dimensions_faces_helper.Revit_Faces)  # package Synthesize toolkit; A (hopefully) more robust implementation of ScopeIf. Tests a single boolean and returns a value accordingly.
code_block_2 = CodeBlock { 2; }
chop = List.Chop(list=scopeIf, lengths=code_block_2)
scopeIf_2 = Custom[CW.ScopeIf+](VARtest=n06_split_dimensions, VARtrue=chop, VARfalse=scopeIf)
dimension_by_reference_curve_and = Custom[Dimension By Reference Curve and Reference Face](Reference_Curve=n01_select_reference_line, Revit_Faces=scopeIf_2@L2)
debug_python = Custom[Debug Python]()  # package Synthesize toolkit; Debug Python
