# Dynamo graph Dimensions.Move Text to Middle By All Dimensions of Active View.dyn (Dynamo 2.13.1.3887)
# author: karam@aecedx.com
# packages: Synthesize toolkit 12.5.1

python_all_elements_in_active = Custom[Python All Elements In Active View]()  # package Synthesize toolkit; Python All Elements In Active View

# group: Input
n01_y_justification_based_on = DoubleSlider(0, range=-100..100 step 0.001)  # "01.Y Justification (Based On Sheet Size)"; graph input
n02_x_justification_based_on = DoubleSlider(0, range=-100..100 step 0.001)  # "02.X Justification (Based On Sheet Size)"; graph input
n03_leader_visibility = BoolSelector(false)  # "03.Leader Visibility ?"; graph input

move_dimension_text_to_middle = Custom[Move Dimension Text to Middle](VARElements=python_all_elements_in_active, VARYJustification=n01_y_justification_based_on, VARXJustification=n02_x_justification_based_on, VARLeaderVisibility=n03_leader_visibility)  # package Synthesize toolkit; Move Dimension Text to Middle
debug_python = Custom[Debug Python]()  # package Synthesize toolkit; Debug Python
