# Dynamo graph External.Generate Illustrator Scripts.dyn (Dynamo 2.13.1.3887)
# author: karam@aecedx.com
# packages: Synthesize toolkit 12.5.1

# group: Input
n01_generate_paths_reducer_script = BoolSelector(true)  # "01.Generate Paths Reducer Script ?"; graph input
n02_paths_reducer_script_export = StringInput("D:\Dynamo Generated Path Reducer illustrator Script.jsx")  # "02.Paths Reducer Script Export Location"; graph input

empty = List.Empty()
scopeIf = Custom[CW.ScopeIf+](VARtest=n01_generate_paths_reducer_script, VARtrue=n02_paths_reducer_script_export, VARfalse=empty)  # package Synthesize toolkit; A (hopefully) more robust implementation of ScopeIf. Tests a single boolean and returns a value accordingly.
string = StringInput("""var idoc = app.activeDocument;  
var howLong = prompt ("Enter the size in points of small paths to be deleted", 2, "Delete Small Paths");  
  
for (i=0 ; i< idoc.pathItems.length; i++)  
     {  
          var ipath = idoc.pathItems[i]  
               if ( ipath.width < howLong && ipath.height < howLong)  
                    {  
                         ipath.selected = true;  
                    }  
     }  
  
app.redraw();   
  
if(confirm ("Proceed to delete selected items?", "yes", "Confirm Delete"))  
     {  
          app.cut();  
     }  
""")
exportCSV = Data.ExportCSV(filePath=scopeIf, data=string)
debug_python = Custom[Debug Python]()  # package Synthesize toolkit; Debug Python
