# Dynamo graph External.Generate Lumion Filters.dyn (Dynamo 2.13.1.3887)
# author: karam@aecedx.com
# packages: Synthesize toolkit 12.5.1

# group: Input
n01_directory_path_to_generate = Directory("No file selected.")  # "01.Directory Path to Generate Filters"; graph input
n02_generate_sunny_filter = BoolSelector(false)  # "02.Generate Sunny Filter"; graph input
n03_generate_golden_hour_filter = BoolSelector(false)  # "03.Generate Golden Hour Filter"; graph input
n04_generate_nighty_filter = BoolSelector(false)  # "04.Generate Nighty Filter"; graph input

al_current_document = Custom[AL.Current Document]()  # package Synthesize toolkit; Retrieves Current Document
get_document_name = Custom[Get Document Name](VARDocument=al_current_document)  # package Synthesize toolkit; Get Document Name
python_script = Python(IN[0]=n01_directory_path_to_generate, IN[1]=n02_generate_sunny_filter, IN[2]=n03_generate_golden_hour_filter, IN[3]=n04_generate_nighty_filter, IN[4]=get_document_name.VARName)  # IronPython2
# ---------- python_script.python (107 lines) ----------
# Enable Python support and load DesignScript library
# IMPORTANT : ALL DYNAMO DESIGN SCRIPT NODES ARE AS (dg)
import sys
sys.path.append(r'C:\Program Files (x86)\IronPython 2.7\DLLs')
sys.path.append(r'C:\Program Files (x86)\IronPython 2.7\Lib')

import clr
clr.AddReference('ProtoGeometry')
from Autodesk.DesignScript import Geometry as dg
from System.Net import WebRequest
# EXTENSION Enable ToDSType
clr.AddReference('RevitNodes')
import Revit
clr.ImportExtensions(Revit.Elements)

# Enable Revit Elements
from Revit.Elements import *

# EXTENSION Enable Geometry Conversion Methods
clr.ImportExtensions(Revit.GeometryConversion)

# Enable Revit API
clr.AddReference('RevitAPI')
from Autodesk.Revit.DB import *

# Enable DocumentManager and TransactionManager
clr.AddReference('RevitServices')
from RevitServices.Persistence import DocumentManager
from RevitServices.Transactions import TransactionManager

# Enable ICollection List Translate
clr.AddReference("System")
import System.Collections.Generic
from System.Collections.Generic import List

import urllib2
import base64

import clr
clr.AddReference("RevitAPIUI")
from Autodesk.Revit.UI import TaskDialog

title = "AECedx - Karam"
alert = TaskDialog

def f(number):
	global filters
	global directory
	global document
	try:
		base64_message = filters[number]
		base64_bytes = base64_message.encode('ascii')
		message_bytes = base64.b64decode(base64_bytes)
		message = message_bytes.decode('ascii')
		messagedec = message.split("KARAM")[1]
		message = message.split("KARAM")[0]
		response = urllib2.urlopen(message)
		html = response.read()
		dec =  directory + "\\" + document + "_" + messagedec
		f= open(dec,"wb")
		f.write(html)
		f.close()
	except:
		pass

# Choose The Current Document
doc = DocumentManager.Instance.CurrentDBDocument
uidoc = DocumentManager.Instance.CurrentUIApplication.ActiveUIDocument
uiapp = DocumentManager.Instance.CurrentUIApplication
app = uiapp.Application


safetogo = True
source = "http://dynamo.aecedx.com/Filters"
try:
	response = urllib2.urlopen(source)
	filters = response.read().split()
except:
	safetogo = False
	OUT = alert.Show(title, "Please Connect to Internet")

directory = IN[0]
f1 = IN[1]
f2 = IN[2]
f3 = IN[3]
document = IN[4]

if safetogo != False:
	requests = False
	if f1:
		if document != None:
			f(1)
		requests = True
	if f2:
		if document != None:
			f(2)
		requests = True
	if f3:
		if document != None:
			f(3)
		requests = True
	if requests == False:
		OUT = alert.Show(title, "Please Activate a Filter to Generate")
	elif document == None:
		OUT = alert.Show(title, "Please Save Your Revit Project")
	else:
		OUT = alert.Show(title, "Generating Lumion Filters Done")
# ----------------------------------------
debug_python = Custom[Debug Python]()  # package Synthesize toolkit; Debug Python
