# Dynamo graph Family.Category Change By Family Names.dyn (Dynamo 2.13.1.3887)
# author: karam@aecedx.com
# packages: Synthesize toolkit 12.5.1

# group: Input
n02_category_to_change_to = Categories("OST_GenericModel")  # "02.Category to Change to :"; graph input
n01_family_names_separate_by = StringInput("Table*")  # "01.Family Names (Separate By Comma , - or * To Select All Matching)"; graph input

code_block = CodeBlock { ","; true; "Type 1"; false; }
family_and_type_selector = Custom[Family and Type Selector](VARAllElementsofFamilyNameAlltypes=code_block.out1, VARFamilyName=n01_family_names_separate_by, VARSpecificTypeNamesSeparatebySymbol=code_block.out2, VARSeparationSymbol=code_block.out0, VAROnlyInActiveView=code_block.out3)  # package Synthesize toolkit; Family and Type Selector
flatten = List.Flatten(list=family_and_type_selector.VARFamilyTypesList)
change_family_category = Custom[Change Family Category](VARCategory=n02_category_to_change_to, VARFamilyTypes=flatten)  # package Synthesize toolkit; Change Family Category
debug_python = Custom[Debug Python]()  # package Synthesize toolkit; Debug Python
