# Dynamo graph Family.Category Change By Selection Filter.dyn (Dynamo 2.13.1.3887)
# author: karam@aecedx.com
# packages: Synthesize toolkit 12.5.1

# group: Input
n02_category_to_change_to = Categories("OST_GenericModel")  # "02.Category to Change to :"; graph input
n01_selection_filter_to_read_and = StringInput("Selection Filter")  # "01.Selection Filter to Read and Change their Category"; graph input

hot_get_all_filter = Custom[HOT.Get All Filter]()  # package Synthesize toolkit; Get all Filter
toLower = String.ToLower(string=hot_get_all_filter.VARName)
trimWhitespace = String.TrimWhitespace(string=toLower)
toLower_2 = String.ToLower(string=n01_selection_filter_to_read_and)
trimWhitespace_2 = String.TrimWhitespace(string=toLower_2)
eq = trimWhitespace == trimWhitespace_2
filterByBoolMask = List.FilterByBoolMask(list=hot_get_all_filter.VARElement, mask=eq)
elements = Custom[CW.SelectionSet.Elements](VARselectionSet=filterByBoolMask.in)  # package Synthesize toolkit; Retrieves all elements stored in a selection set
flatten = List.Flatten(list=elements)
elementType = Element.ElementType(element=flatten)
flatten_2 = List.Flatten(list=elementType)
uniqueItems = List.UniqueItems(list=flatten_2)
change_family_category = Custom[Change Family Category](VARCategory=n02_category_to_change_to, VARFamilyTypes=uniqueItems)  # package Synthesize toolkit; Change Family Category
debug_python = Custom[Debug Python]()  # package Synthesize toolkit; Debug Python
