# Dynamo graph Family.Category Change By Selection.dyn (Dynamo 2.13.1.3887)
# author: karam@aecedx.com
# packages: Synthesize toolkit 12.5.1

# group: Input
n02_category_to_change_to = Categories("OST_GenericModel")  # "02.Category to Change to :"; graph input
n01_select_families_to_change = DSModelElementsSelection()  # "01.Select Families to Change their Category"; nothing selected; graph input

elementType = Element.ElementType(element=n01_select_families_to_change)
flatten = List.Flatten(list=elementType)
uniqueItems = List.UniqueItems(list=flatten)
change_family_category = Custom[Change Family Category](VARCategory=n02_category_to_change_to, VARFamilyTypes=uniqueItems)  # package Synthesize toolkit; Change Family Category
debug_python = Custom[Debug Python]()  # package Synthesize toolkit; Debug Python
