# Dynamo graph Family.Delete Duplicated Elements.dyn (Dynamo 2.13.1.3887)
# author: karam@aecedx.com
# packages: Synthesize toolkit 12.5.1

# group: Input
n01_detection_mode_false_visible = BoolSelector(false)  # "01.Detection Mode: False = Visible Elements Only | True =All Project"; graph input

python_all_elements_in_all = Custom[Python All Elements In All Document]()  # package Synthesize toolkit; Python All Elements In All Document
python_all_elements_in_active = Custom[Python All Elements In Active View]()  # package Synthesize toolkit; Python All Elements In Active View
scopeIf = Custom[CW.ScopeIf+](VARtest=n01_detection_mode_false_visible, VARtrue=python_all_elements_in_all, VARfalse=python_all_elements_in_active)  # package Synthesize toolkit; A (hopefully) more robust implementation of ScopeIf. Tests a single boolean and returns a value accordingly.
delete_duplicated_elements_from = Custom[Delete Duplicated Elements From List](VARElementsList=scopeIf)  # package Synthesize toolkit; Delete Duplicated Elements From List
