# Dynamo graph Family.Delete Tolerance By Selection Filter.dyn (Dynamo 2.13.1.3887)
# author: karam@aecedx.com
# packages: Synthesize toolkit 12.5.1

hot_get_all_filter = Custom[HOT.Get All Filter]()  # package Synthesize toolkit; Get all Filter
toLower = String.ToLower(string=hot_get_all_filter.VARName)
trimWhitespace = String.TrimWhitespace(string=toLower)

# group: Input
n01_selection_filter_to_read = StringInput("Fitler Name")  # "01.Selection Filter to Read"; graph input
tolerance = DoubleInput(5)  # "02.Tolerance"; graph input

toLower_2 = String.ToLower(string=n01_selection_filter_to_read)
trimWhitespace_2 = String.TrimWhitespace(string=toLower_2)
eq = trimWhitespace == trimWhitespace_2
filterByBoolMask = List.FilterByBoolMask(list=hot_get_all_filter.VARElement, mask=eq)
elements = Custom[CW.SelectionSet.Elements](VARselectionSet=filterByBoolMask.in)  # package Synthesize toolkit; Retrieves all elements stored in a selection set
flatten = List.Flatten(list=elements)
location_of_any_element = Custom[Location Of Any Element](VARElements=flatten)  # package Synthesize toolkit; Location Of Any Element
pruneDuplicates = Point.PruneDuplicates(points=location_of_any_element.VARLocations, tolerance=tolerance)
contains = List.Contains(list=pruneDuplicates, item=location_of_any_element.VARLocations@@L1)
filterByBoolMask_2 = List.FilterByBoolMask(list=location_of_any_element.VARElements, mask=contains)
eraser = Custom[ST.Tool.Eraser](VARList=filterByBoolMask_2.out)  # package Synthesize toolkit; Try to delete any element from project
count = List.Count(list=location_of_any_element.VARElements)

# group: Result
selected = Watch(count)  # "01.No.Selected"; graph output

debug_python = Custom[Debug Python]()  # package Synthesize toolkit; Debug Python
