# Dynamo graph Family.Family Type Smart Change By All Elements of Active View.dyn (Dynamo 2.13.1.3887)
# author: karam@aecedx.com
# packages: Synthesize toolkit 12.5.1

python_all_elements_in_active = Custom[Python All Elements In Active View]()  # package Synthesize toolkit; Python All Elements In Active View

# group: Input
n01_target_family_type = FamilyTypes()  # "01.Target Family Type"; nothing selected; graph input
n02_change_type_values_too = BoolSelector(false)  # "02.Change Type Values Too ?"; graph input
n03_full_replace_adaptive_only = BoolSelector(false)  # "03.Full Replace ? (Adaptive Only)"; graph input

smart_family_type_change = Custom[Smart Family Type Change](VARElements=python_all_elements_in_active, VARTargetFamilyType=n01_target_family_type, VARChangeTypeValuesToo=n02_change_type_values_too, VARFullReplaceAdaptiveOnly=n03_full_replace_adaptive_only)  # package Synthesize toolkit; Smart Family Type Change
debug_python_no_message = Custom[Debug Python No Message]()  # package Synthesize toolkit; Debug Python
