# Dynamo graph Family.Flip Workplane By All Elements of Category.dyn (Dynamo 2.13.1.3887)
# author: karam@aecedx.com
# packages: Synthesize toolkit 12.5.1

# group: Input
category = Categories()  # "01.Category"; nothing selected; graph input
n02_flip_workplane = BoolSelector(false)  # "02.Flip Workplane ?"; graph input

all_elements_of_category = ElementsOfCategory(Category=category)
flatten = List.Flatten(list=all_elements_of_category)
flipWorkplane = Custom[FlipWorkplane](VARElements=flatten, VARFlip=n02_flip_workplane)  # package Synthesize toolkit; FlipWorkplane
debug_python_no_message = Custom[Debug Python No Message]()  # package Synthesize toolkit; Debug Python
