# Dynamo graph Family.Flip Workplane By Selection.dyn (Dynamo 2.13.1.3887)
# author: karam@aecedx.com
# packages: Synthesize toolkit 12.5.1

# group: Input
n01_select_elements = DSModelElementsSelection()  # "01.Select Elements"; nothing selected; graph input
n02_flip_workplane = BoolSelector(false)  # "02.Flip Workplane ?"; graph input

flipWorkplane = Custom[FlipWorkplane](VARElements=n01_select_elements, VARFlip=n02_flip_workplane)  # package Synthesize toolkit; FlipWorkplane
debug_python_no_message = Custom[Debug Python No Message]()  # package Synthesize toolkit; Debug Python
