# Dynamo graph Family.Generate (Import Symbol or Family) By Fractal Tree.dyn (Dynamo 2.13.1.3887)
# author: karam@aecedx.com
# packages: Synthesize toolkit 12.5.1

# group: Input
n25_create_selection_filter = BoolSelector(true)  # "25.Create Selection Filter ?"; graph input
n26_filter_name_to_create = StringInput("Dynamo Generated Import Symbol or Family")  # "26.Filter Name to Create"; graph input
n27_overwrite_existing_filter = BoolSelector(false)  # "27.Overwrite Existing Filter ? (False for Adding Elements)"; graph input
n02_trunk_length_in_meters = DoubleInput(1)  # "02.Trunk Length (In Meters)"; graph input
n01_sides_1_one_side_2_two_sides = IntegerSlider(2, range=1..4 step 1)  # "01.Sides: 1 = One Side | 2 = Two Sides | 3 = Three Sides | 4 = Four Sides"; graph input
n05_bushes_scale = DoubleSlider(0.75, range=0.5..1 step 0.05)  # "05.Bushes Scale"; graph input
n06_angle_minimum = IntegerSlider(-25, range=-45..0 step 1)  # "06.Angle Minimum"; graph input
n07_angle_maximum = IntegerSlider(35, range=1..45 step 1)  # "07.Angle Maximum"; graph input
repetition = IntegerSlider(4, range=1..10 step 1)  # "08.Repetition"; graph input
n09_randomness_factor_minimum = DoubleSlider(0.7, range=0..1 step 0.01)  # "09.Randomness Factor Minimum Range"; graph input
n10_randomness_factor_maximum = DoubleSlider(1.3, range=1..2 step 0.01)  # "10.Randomness Factor Maximum Range"; graph input
n03_bushes_width_in_meters = DoubleInput(0.2)  # "03.Bushes Width (In Meters)"; graph input
n04_tree_thickness_in_meters = DoubleInput(0.05)  # "04.Tree Thickness (In Meters)"; graph input
n12_family_method_one_family = BoolSelector(false)  # "12.Family Method : One Family ?"; graph input
n17_family_method_sequence_naming = BoolSelector(true)  # "17.Family Method : Sequence Naming Mode : True = Auto | False = Manual"; graph input
n16_family_method_family_name = StringInput("Dynamo Fractle Tree")  # "16.Family Method : Family Name"; graph input
n18_family_method_start_sequence = DoubleInput(1)  # "18.Family Method : Start Sequence (Naming Suffix) - Manual Mode"; graph input
n22_family_method_category = Categories("OST_Planting")  # "22.Family Method : Category"; graph input
n24_family_method_family_template = Filename("..\..\..\..\..\..\..\..\..\..\ProgramData\Autodesk\RVT 2020\Family Templates\English\Metric Generic Model.rft")  # "24.Family Method : Family Template of The Above Category"; graph input
n14_family_method_is_shared = BoolSelector(false)  # "14.Family Method : Is Shared Family ?"; graph input
n15_family_method_to_void = BoolSelector(false)  # "15.Family Method : To Void ?"; graph input
n19_family_method_material = StringInput("Default Fractle Material")  # "19.Family Method : Material"; graph input
n21_family_method_material_single = BoolSelector(true)  # "21.Family Method : Material: Single Parameter Only ?"; graph input
n20_family_method_material_is = BoolSelector(true)  # "20.Family Method : Material: Is Instance Parameter ?"; graph input
n23_family_method_subcategory = StringInput("")  # "23.Family Method : Subcategory"; graph input
n13_family_method_self_origin = BoolSelector(true)  # "13.Family Method : Self Origin ?"; graph input
n11_method_false_import_symbol = BoolSelector(true)  # "11.Method: False = Import Symbol | True = Family"; graph input

code_block = CodeBlock { "Please Select Faces To Generate Trees Onto"; }
bk_popup_message_box = Custom[BK.Popup Message Box](VARmessage=code_block)  # package Synthesize toolkit; from Dynamo Player samples
selectFaces = Custom[SP.SelectFaces+](VARrefresh=bk_popup_message_box)  # package Synthesize toolkit; Select multiple faces from inside the Revit UI. Be sure to press "Finish" once done. Unlike the built-in node, face references of instances will be added sucessfully and you'l get the pick points. You can use a Boolean toggle to refresh your selection.
ZAxis = Vector.ZAxis()
convert_between_units = DynamoConvert(n02_trunk_length_in_meters, MeasurementType="Length", FromConversion="Meters", ToConversion="Feet")
unit_types = UnitTypes("Length")
displayUnitType = Custom[CW.UnitType.DisplayUnitType](VARunitType=unit_types)  # package Synthesize toolkit; Retrieves the display unit type for a given unit type.
toDisplayUnit = Custom[CW.InternalUnit.ToDisplayUnit](VARval=convert_between_units, VARdisplayUnitType=displayUnitType.VARdisplayUnitType)  # package Synthesize toolkit; Converts a value from Revit's internal unit to a given display unit
translate = Geometry.Translate(geometry=selectFaces.VARpickPoints, direction=ZAxis, distance=toDisplayUnit)
byStartPointEndPoint = Line.ByStartPointEndPoint(startPoint=selectFaces.VARpickPoints, endPoint=translate)
turnIntoList = Custom[CW.TurnIntoList](VARunknownItem=byStartPointEndPoint)  # package Synthesize toolkit; Turns an element (or a nested list) into a flat list
ofRepeatedItem = List.OfRepeatedItem(item=turnIntoList, amount=n01_sides_1_one_side_2_two_sides)
transpose = List.Transpose(lists=ofRepeatedItem)
flatten = List.Flatten(list=transpose)
fractle_tree_lines = Custom[Fractle Tree Lines](VARInitialCurves=flatten, VARBushesScale=n05_bushes_scale, VARAngleMin=n06_angle_minimum, VARAngleMax=n07_angle_maximum, VARRepetition=repetition, VARRandomnessMin=n09_randomness_factor_minimum, VARRandomnessMax=n10_randomness_factor_maximum)  # package Synthesize toolkit; Fractle Tree Lines
count = List.Count(list=transpose@L2)
chop = List.Chop(list=fractle_tree_lines, lengths=count)
convert_between_units_2 = DynamoConvert(n03_bushes_width_in_meters, MeasurementType="Length", FromConversion="Meters", ToConversion="Feet")
toDisplayUnit_2 = Custom[CW.InternalUnit.ToDisplayUnit](VARval=convert_between_units_2, VARdisplayUnitType=displayUnitType.VARdisplayUnitType)
YAxis = Vector.YAxis()
python_script = Python(IN[0]=chop, IN[1]=toDisplayUnit_2, IN[2]=YAxis)  # IronPython2
# ---------- python_script.python (34 lines) ----------
import sys
import clr
clr.AddReference('ProtoGeometry')
from Autodesk.DesignScript.Geometry import *
import clr
from System.Reflection import Assembly
from System.Diagnostics import Process
dynamoCore = Assembly.Load("DynamoCore")
version_long = dynamoCore.GetName().Version.ToString()
import System
pf_path = System.Environment.GetFolderPath(System.Environment.SpecialFolder.ProgramFilesX86)
import sys
sys.path.append('%s\IronPython 2.7\Lib' %pf_path)
from distutils.version import LooseVersion
listsoflists = IN[0]
thickness =  IN[1]
normal = IN[2]
isold = LooseVersion(version_long) < LooseVersion("2.10.1")
result = []
for lists in listsoflists:
	tmpup = []
	for list in lists:
		tmp = []
		for curve in list:
			try:
				if isold:
					tmp.append(PolyCurve.ByThickeningCurve(curve,thickness,normal))
				else:
					tmp.append(PolyCurve.ByThickeningCurveNormal(curve,thickness,normal))
			except:
				tmp.append(None)
		tmpup.append(tmp)
	result.append(tmpup)
OUT = result
# ----------------------------------------
python_script_2 = Python(IN[0]=python_script, IN[1]=turnIntoList, IN[2]=n01_sides_1_one_side_2_two_sides)  # IronPython2
# ---------- python_script_2.python (36 lines) ----------
import clr
clr.AddReference('ProtoGeometry')
from Autodesk.DesignScript.Geometry import *
#The inputs to this node will be stored as a list in the IN variables.
dataEnteringNode = IN

lists = IN[0]
initcurves = IN[1]

if IN[2] == 2:
	divs = [0,90]
elif IN[2] == 4:
	divs = [0,45,90,135]
elif IN[2] == 3:
	divs = [0,120,240]
elif IN[2] == 1:
	divs = False

result = []
count = 0
for lines in lists:
	init = initcurves[count]
	plane = Plane.ByOriginNormal(init.StartPoint,Vector.ZAxis())
	count += 1
	tmp = []
	innercount = 0
	for l in lines:
		for x in l:
			if divs != False:
				tmp.append(Geometry.Rotate(x,plane,divs[innercount]))
			else:
				tmp.append(x)
		innercount += 1
	result.append(tmp)
#Assign your output to the OUT variable.
OUT = result
# ----------------------------------------
byPatch = Surface.ByPatch(closedCurve=python_script_2)
convert_between_units_3 = DynamoConvert(n04_tree_thickness_in_meters, MeasurementType="Length", FromConversion="Meters", ToConversion="Feet")
toDisplayUnit_3 = Custom[CW.InternalUnit.ToDisplayUnit](VARval=convert_between_units_3, VARdisplayUnitType=displayUnitType.VARdisplayUnitType)
thicken = Surface.Thicken(surface=byPatch, thickness=toDisplayUnit_3)
byUnion = Custom[CW.Solid.ByUnion+](VARsolids=thicken@L2)  # package Synthesize toolkit; The OOTB node Solid.ByUnion occasionally fails when trying to merge solids with almost adjacent faces. This node will return the minimum amount of joined solids possible in such cases instead of returning null.
flatten_2 = List.Flatten(list=byUnion)
code_block_2 = CodeBlock { true; }
code_block_3 = CodeBlock { true; }
ne = code_block_3 != n11_method_false_import_symbol
k_family_insert = Custom[K-Family Insert](VARGeometryorSAT=flatten_2, VAROneFamily=n12_family_method_one_family, VARAvoidConfilct=n17_family_method_sequence_naming, VARFamilyName=n16_family_method_family_name, VARFamilyNumber=n18_family_method_start_sequence, VARFamilyCategory=n22_family_method_category, VARFamilyTemplatePath=n24_family_method_family_template, VARIsShared=n14_family_method_is_shared, VARIsWorkplane=code_block_2, VARIsAlwaysVertical=code_block_2, VARToVoid=n15_family_method_to_void, VARMaterialName=n19_family_method_material, VARIsOneMaterial=n21_family_method_material_single, VARIsMaterialInstance=n20_family_method_material_is, VARSubcategory=n23_family_method_subcategory, VARSelfOrigin=n13_family_method_self_origin, VARImportInstanceInstead=ne)  # package Synthesize toolkit; K-Family Insert
flatten_3 = List.Flatten(list=k_family_insert.VARFamilyInstancesOrImportSymbols)
generate_selection_filter = Custom[Generate Selection Filter](VARCreateSelectionFilter=n25_create_selection_filter, VARFilterNametoCreate=n26_filter_name_to_create, VAROverwriteExistingFilter=n27_overwrite_existing_filter, VARElements=flatten_3)  # package Synthesize toolkit; Generate Selection FIlter
debug_python_no_message = Custom[Debug Python No Message]()  # package Synthesize toolkit; Debug Python
