# Dynamo graph Family.Generate (Import Symbol or Family) By SAT File.dyn (Dynamo 2.13.1.3887)
# author: karam@aecedx.com
# packages: Synthesize toolkit 12.5.1

# group: Input
n18_create_selection_filter = BoolSelector(true)  # "18.Create Selection Filter ?"; graph input
n19_filter_name_to_create = StringInput("Dynamo Generated Import Symbol or Family")  # "19.Filter Name to Create"; graph input
n20_overwrite_existing_filter = BoolSelector(false)  # "20.Overwrite Existing Filter ? (False for Adding Elements)"; graph input
n01_sat_file = Filename("D:\ExportedGeometry.sat")  # "01.SAT File"; graph input
n05_family_method_one_family = BoolSelector(true)  # "05.Family Method : One Family ?"; graph input
n10_family_method_sequence_naming = BoolSelector(true)  # "10.Family Method : Sequence Naming Mode : True = Auto | False = Manual"; graph input
n03_join_adjacent_surfaces = BoolSelector(false)  # "03.Join Adjacent Surfaces ?"; graph input
n02_join_adjacent_solids = BoolSelector(false)  # "02.Join Adjacent Solids ?"; graph input
n09_family_method_family_name = StringInput("Dynamo Solid or Void Family")  # "09.Family Method : Family Name"; graph input
n11_family_method_start_sequence = DoubleInput(1)  # "11.Family Method : Start Sequence (Naming Suffix) - Manual Mode"; graph input
n15_family_method_category = Categories("OST_GenericModel")  # "15.Family Method : Category"; graph input
n17_family_method_family_template = Filename("..\..\..\..\..\..\..\..\..\..\ProgramData\Autodesk\RVT 2020\Family Templates\English\Metric Generic Model.rft")  # "17.Family Method : Family Template of The Above Category"; graph input
n07_family_method_is_shared = BoolSelector(false)  # "07.Family Method : Is Shared Family ?"; graph input
n08_family_method_to_void = BoolSelector(false)  # "08.Family Method : To Void ?"; graph input
n12_family_method_material = StringInput("")  # "12.Family Method : Material"; graph input
n14_family_method_material_single = BoolSelector(true)  # "14.Family Method : Material: Single Parameter Only ?"; graph input
n13_family_method_material_is = BoolSelector(true)  # "13.Family Method : Material: Is Instance Parameter ?"; graph input
n16_family_method_subcategory = StringInput("")  # "16.Family Method : Subcategory"; graph input
n06_family_method_self_origin = BoolSelector(true)  # "06.Family Method : Self Origin ?"; graph input
n04_method_false_import_symbol = BoolSelector(true)  # "04.Method : False = Import Symbol | True = Family"; graph input

better_geometry_importfromsat = Custom[Better Geometry.ImportFromSAT](VARSATFile=n01_sat_file)  # package Synthesize toolkit; Better Geometry.ImportFromSAT
code_block = CodeBlock { true; }
ne = code_block != n04_method_false_import_symbol
k_family_insert = Custom[K-Family Insert](VARGeometryorSAT=better_geometry_importfromsat, VAROneFamily=n05_family_method_one_family, VARAvoidConfilct=n10_family_method_sequence_naming, VARJoinAdjacentSurfacesForcesDynamoProcessSAT=n03_join_adjacent_surfaces, VARJoinAdjacentSolidsForcesDynamoProcessSAT=n02_join_adjacent_solids, VARFamilyName=n09_family_method_family_name, VARFamilyNumber=n11_family_method_start_sequence, VARFamilyCategory=n15_family_method_category, VARFamilyTemplatePath=n17_family_method_family_template, VARIsShared=n07_family_method_is_shared, VARToVoid=n08_family_method_to_void, VARMaterialName=n12_family_method_material, VARIsOneMaterial=n14_family_method_material_single, VARIsMaterialInstance=n13_family_method_material_is, VARSubcategory=n16_family_method_subcategory, VARSelfOrigin=n06_family_method_self_origin, VARImportInstanceInstead=ne)  # package Synthesize toolkit; K-Family Insert
flatten = List.Flatten(list=k_family_insert.VARFamilyInstancesOrImportSymbols)
generate_selection_filter = Custom[Generate Selection Filter](VARCreateSelectionFilter=n18_create_selection_filter, VARFilterNametoCreate=n19_filter_name_to_create, VAROverwriteExistingFilter=n20_overwrite_existing_filter, VARElements=flatten)  # package Synthesize toolkit; Generate Selection FIlter
debug_python_no_message = Custom[Debug Python No Message]()  # package Synthesize toolkit; Debug Python
code_block_2 = CodeBlock { "Solid"; "Surface"; }
byClassName = Custom[SP.Filter.ByClassName](VARobject=better_geometry_importfromsat, VARclassName=code_block_2.out0)  # package Synthesize toolkit; Filters a list of objects by the object's class name. Note that Dynamo elements belong to different classes than their Revit counterparts. Use the Object.Class node to check an object's class.
byClassName_2 = Custom[SP.Filter.ByClassName](VARobject=byClassName.VARout, VARclassName=code_block_2.out1)
byCurve = ModelCurve.ByCurve()  # unwired: curve
map = List.Map(list=byClassName_2.VARout, f_x=byCurve)
