# Dynamo graph Family.Generate 8 Points Adaptive Family By Solid.dyn (Dynamo 2.13.1.3887)
# author: karam@aecedx.com
# packages: Synthesize toolkit 12.5.1

# group: Input
n01_select_solid_geometry = DSModelElementSelection()  # "01.Select Solid Geometry"; nothing selected; graph input
n02_file_path = Filename("C:\ProgramData\Autodesk\RVT 2020\Family Templates\English\Metric Generic Model Adaptive.rft")  # "02.File Path"; graph input
categories = 04.Categories("OST_GenericModel")  # graph input
n03_family_name = StringInput("Dynamo 8 Points Solid Adaptive")  # "03.Family Name"; graph input

solids = Element.Solids(element=n01_select_solid_geometry)
flatten = List.Flatten(list=solids)
smart_rft_path = Custom[Smart RFT Path](VARRFTFile=n02_file_path, VARCategory=categories)  # package Synthesize toolkit; Smart RFT Path
n8_points_adaptive_family_by = Custom[8 Points Adaptive Family By Geometry](VARgeometry=flatten, VARfamilytemplatepath=smart_rft_path, VARfamilyname=n03_family_name, VARcategory=categories)  # package Synthesize toolkit; 8 Points Adaptive Family By Geometry
debug_python = Custom[Debug Python]()  # package Synthesize toolkit; Debug Python
