# Dynamo graph Family.Generate Grid Family.dyn (Dynamo 2.13.1.3887)
# author: karam@aecedx.com
# packages: Synthesize toolkit 12.5.1

# group: Input
n01_origin_corner_origin_false = BoolSelector(false)  # "01.Origin: Corner Origin = False | Center Origin = True"; graph input
n02_measurement_by_distance_false = BoolSelector(false)  # "02.Measurement: By Distance = False | By Number = True"; graph input

python_script = Python(IN[0]=n01_origin_corner_origin_false, IN[1]=n02_measurement_by_distance_false)  # IronPython2
# ---------- python_script.python (69 lines) ----------
import clr
clr.AddReference('RevitAPI') 
import Autodesk
from Autodesk.Revit.DB import *
clr.AddReference('RevitServices')
from RevitServices.Persistence import DocumentManager
from RevitServices.Transactions import TransactionManager
clr.AddReference("RevitAPIUI")
from Autodesk.Revit.UI import TaskDialog
clr.AddReference('DynamoRevitDS')
import Dynamo 
import System
pf_path = System.Environment.GetFolderPath(System.Environment.SpecialFolder.ProgramFilesX86)
import sys
sys.path.append('%s\IronPython 2.7\Lib' %pf_path)
import os.path 

class FamOptions(IFamilyLoadOptions):
	def __init__(self):
		pass
	def OnFamilyFound(self,familyInUse, overwriteParameterValues):
		overwriteParameterValues.Value = False
		return True
	def OnSharedFamilyFound(self,familyInUse, source, overwriteParameterValues):
		overwriteParameterValues.Value = False
		return True

doc = DocumentManager.Instance.CurrentDBDocument

family = IN[0]
bynumber = IN[1]

if family:
	famname = "Grid Center"
else:
	famname = "Grid Corner"
if bynumber:
	famname = famname + " Number"
else:
	famname = famname + " Distance"

stringedfamname = '"' + famname + '"'

checkfamily = [x for x in FilteredElementCollector(doc).OfClass(Family).ToElements() if famname.lower() == x.Name.lower()]
if len(checkfamily) == 0:
	script = Dynamo.Applications.DynamoRevit().RevitDynamoModel.CurrentWorkspace.FileName.split("\\")[:-1]
	fullpath = "\\".join(script) + "\\" + "Sample " + famname + ".rfa"
	if os.path.isfile(fullpath):
		TransactionManager.Instance.ForceCloseTransaction()
		trans1 = Transaction(doc, 'Load ' + famname)
		trans1.Start()
		loadedfamily = doc.LoadFamily(fullpath,FamOptions())[1]
		loadedfamily.Name = famname
		symbol = loadedfamily.GetFamilySymbolIds().GetEnumerator()
		symbol.MoveNext()
		symbol = doc.GetElement(symbol.Current)
		symbol.Name = famname
		if not symbol.IsActive: symbol.Activate()
		trans1.Commit()
		result = "Family " + stringedfamname + " Is Now Loaded\nUse Component Command to Place It\n\n*Grid Is Visibile In 'Coarse' Detail Level Only"
		TaskDialog.Show("AECedx - Karam", result)
	else:
		result = "Unknown Error: Please Contact Karam\n karam@aecedx.com"
		TaskDialog.Show("AECedx - Karam", result)
else:
	result = stringedfamname + " Is Already Loaded\nUse Component Command to Place It\n\n*Grid Is Visibile In 'Coarse' Detail Level Only"
	TaskDialog.Show("AECedx - Karam", result)

OUT = result
# ----------------------------------------

# group: Output
report = Watch(python_script)  # "01.Report"; graph output

debug_python_no_message = Custom[Debug Python No Message]()  # package Synthesize toolkit; Debug Python
