# Dynamo graph Family.K-Flatten By Families - Multiple Selection.dyn (Dynamo 2.13.1.3887)
# author: karam@aecedx.com
# packages: Synthesize toolkit 12.5.1

debug_python_no_message = Custom[Debug Python No Message]()  # package Synthesize toolkit; Debug Python

# group: Input
n01_select_family = DSModelElementSelection()  # "01.Select Family"; nothing selected; graph input
n10_family_template_rft_generic = Filename("..\..\..\ProgramData\Autodesk\RVT 2020\Family Templates\English\Metric Generic Model.rft")  # "10.Family Template .RFT (Generic Model Recommended)"; graph input
n08_overwrite_parameters_if = BoolSelector(true)  # "08.Overwrite Parameters If Unhosted Family Already Loaded ?"; graph input
n09_name_separator = StringInput("_")  # "09.Name Separator"; graph input
n07_host_width_if_found_0_will = DoubleInput(0)  # "07.Host Width If Found (0 Will Use Default)"; graph input
n06_force_workplane = BoolSelector(false)  # "06.Force Workplane ?"; graph input
n04_change_placement_plane = BoolSelector(false)  # "04.Change Placement Plane ?"; graph input
n05_flip_direction = BoolSelector(false)  # "05.Flip Direction ?"; graph input
n02_origin_bottom_0_top_1_center = IntegerSlider(0, range=0..3 step 1)  # "02.Origin: Bottom = 0 | Top = 1 | Center = 2 | Default = 3"; graph input
n03_rotation_0_degrees_0_90 = IntegerSlider(0, range=0..3 step 1)  # "03.Rotation: 0 Degrees = 0 | 90 Degrees = 1 | 180 Degrees = 2 | 270 Degrees = 3"; graph input

python_script = Python(IN[0]=n01_select_family)  # IronPython2
# ---------- python_script.python (41 lines) ----------
import clr
clr.AddReference('ProtoGeometry')
from Autodesk.DesignScript.Geometry import *
#The inputs to this node will be stored as a list in the IN variables.
dataEnteringNode = IN

def tolist(obj1):
	if hasattr(obj1,'__iter__'): return obj1
	else: return [obj1]

def uniqueIndexes(l):
    seen = set()
    res = []
    for i, n in enumerate(l):
        if n not in seen:
            res.append(i)
            seen.add(n)
    return res

sourceinstances = UnwrapElement(tolist(IN[0]))
cleaninstances = []
types = []
for sourceinstance in sourceinstances:
	famtypename = sourceinstance.Symbol.GetParameters("Type Name")[0].AsString()
	nametotest = famtypename.lower()
	if "rigged" in nametotest:
		continue
	else:
		cleaninstances.append(sourceinstance)
		types.append(famtypename)
unique = uniqueIndexes(types)

result = []
count = 0
for cleaninstance in cleaninstances:
	if count in unique:
		result.append(cleaninstance)
	count += 1

#Assign your output to the OUT variable.
OUT = result
# ----------------------------------------
smart_rft_path = Custom[Smart RFT Path](VARRFTFile=n10_family_template_rft_generic)  # package Synthesize toolkit; Smart RFT Path
k_flatten_family = Custom[K-Flatten Family](VARFamilyInstance=n01_select_family@L1, VARFamilyTemplate=smart_rft_path, VAROverwriteParameters=n08_overwrite_parameters_if, VARSeparators=n09_name_separator, VARInitialHostWidth=n07_host_width_if_found_0_will, VARForceWorkPlaneBased=n06_force_workplane, VARChangePlane=n04_change_placement_plane, VARDirectionFlip=n05_flip_direction, VARPosition=n02_origin_bottom_0_top_1_center, VARRotation=n03_rotation_0_degrees_0_90)  # package Synthesize toolkit; K-Unhost Family
