# Dynamo graph Family.K-Override By Elements Copy Graphic Overrides.dyn (Dynamo 2.13.1.3887)
# author: karam@aecedx.com
# packages: Synthesize toolkit 12.5.1

# group: Input
n05_override_plan_views = BoolSelector(true)  # "05.Override Plan Views"; graph input
n06_1_exact_name_2_contains_name = IntegerSlider(3, range=1..3 step 1)  # "06.1 = Exact Name | 2 = Contains Name | 3 = All"; graph input
n07_plan_view_name = StringInput("Level 1")  # "07.Plan View Name"; graph input
n14_override_ceiling_views = BoolSelector(false)  # "14.Override Ceiling Views"; graph input
n15_1_exact_name_2_contains_name = IntegerSlider(3, range=1..3 step 1)  # "15.1 = Exact Name | 2 = Contains Name | 3 = All"; graph input
n16_ceiling_view_name = StringInput("Level 1")  # "16.Ceiling View Name"; graph input
n23_override_structural_views = BoolSelector(false)  # "23.Override Structural Views"; graph input
n24_1_exact_name_2_contains_name = IntegerSlider(3, range=1..3 step 1)  # "24.1 = Exact Name | 2 = Contains Name | 3 = All"; graph input
n25_structural_view_name = StringInput("Level 1")  # "25.Structural View Name"; graph input
n17_override_area_views = BoolSelector(false)  # "17.Override Area Views"; graph input
n18_1_exact_name_2_contains_name = IntegerSlider(3, range=1..3 step 1)  # "18.1 = Exact Name | 2 = Contains Name | 3 = All"; graph input
n19_area_view_name = StringInput("Level 1")  # "19.Area View Name"; graph input
n08_override_elevation_views = BoolSelector(true)  # "08.Override Elevation Views"; graph input
n09_1_exact_name_2_contains_name = IntegerSlider(3, range=1..3 step 1)  # "09.1 = Exact Name | 2 = Contains Name | 3 = All"; graph input
n10_elevation_view_name = StringInput("North")  # "10.Elevation View Name"; graph input
n11_override_section_views = BoolSelector(true)  # "11.Override Section Views"; graph input
n12_1_exact_name_2_contains_name = IntegerSlider(3, range=1..3 step 1)  # "12.1 = Exact Name | 2 = Contains Name | 3 = All"; graph input
n13_section_view_name = StringInput("Section 1")  # "13.Section View Name"; graph input
n02_override_3d_views = BoolSelector(true)  # "02.Override 3D Views"; graph input
n03_1_exact_name_2_contains_name = IntegerSlider(3, range=1..3 step 1)  # "03.1 = Exact Name | 2 = Contains Name | 3 = All"; graph input
n04_3d_view_name = StringInput("{3D}")  # "04.3D View Name"; graph input
n20_override_detail_views = BoolSelector(false)  # "20.Override Detail Views"; graph input
n21_1_exact_name_2_contains_name = IntegerSlider(3, range=1..3 step 1)  # "21.1 = Exact Name | 2 = Contains Name | 3 = All"; graph input
n22_detail_view_name = StringInput("Detail 0")  # "22.Detail View Name"; graph input
n01_mode_false_visible_elements = BoolSelector(false)  # "01.Mode : False = Visible Elements In Active View | True = All Elements In Project"; graph input

python_script = Python(IN[0]=n05_override_plan_views, IN[1]=n06_1_exact_name_2_contains_name, IN[2]=n07_plan_view_name, IN[3]=n14_override_ceiling_views, IN[4]=n15_1_exact_name_2_contains_name, IN[5]=n16_ceiling_view_name, IN[6]=n23_override_structural_views, IN[7]=n24_1_exact_name_2_contains_name, IN[8]=n25_structural_view_name, IN[9]=n17_override_area_views, IN[10]=n18_1_exact_name_2_contains_name, IN[11]=n19_area_view_name, IN[12]=n08_override_elevation_views, IN[13]=n09_1_exact_name_2_contains_name, IN[14]=n10_elevation_view_name, IN[15]=n11_override_section_views, IN[16]=n12_1_exact_name_2_contains_name, IN[17]=n13_section_view_name, IN[18]=n02_override_3d_views, IN[19]=n03_1_exact_name_2_contains_name, IN[20]=n04_3d_view_name, IN[21]=n20_override_detail_views, IN[22]=n21_1_exact_name_2_contains_name, IN[23]=n22_detail_view_name)  # IronPython2
# ---------- python_script.python (231 lines) ----------
# Filtering Codes By Karam Baki, karam@aecedx.com
# Copyright(c) 2014, Konrad Sobon
# @arch_laboratory, http://archi-lab.net

import clr
clr.AddReference('ProtoGeometry')
from Autodesk.DesignScript.Geometry import *
 
# Import DocumentManager and TransactionManager
clr.AddReference("RevitServices")
import RevitServices
from RevitServices.Persistence import DocumentManager
from RevitServices.Transactions import TransactionManager
 
# Import RevitAPI
clr.AddReference("RevitAPI")
import Autodesk
from Autodesk.Revit.DB import *
 
doc = DocumentManager.Instance.CurrentDBDocument
uiapp = DocumentManager.Instance.CurrentUIApplication
app = uiapp.Application
 
from System.Collections.Generic import *
 
# Import ToDSType(bool) extension method
clr.AddReference("RevitNodes")
import Revit
clr.ImportExtensions(Revit.Elements)

#collect all views in the model
collector = FilteredElementCollector(doc)
views = collector.OfClass(View).ToElements()
 
#sort views into separate lists based on view type
areaPlans, ceilingPlans, columnSchedules = [], [], []
costReport, details, draftingViews = [], [], []
drawingSheets, elevations, engineetingPlans = [], [], []
floorPlans, internal, legends, loadReports = [], [], [], []
panelSchedules, pressureLossReports, renderings = [], [], []
reports, schedules, sections, threeD = [], [], [], []
undefined, walkthrough = [], []
for i in views:
	if not i.IsTemplate:
		if i.ViewType == ViewType.AreaPlan:
			areaPlans.append(i.ToDSType(True))
		elif i.ViewType == ViewType.CeilingPlan:
			ceilingPlans.append(i.ToDSType(True))
		elif i.ViewType == ViewType.ColumnSchedule:
			columnSchedules.append(i.ToDSType(True))
		elif i.ViewType == ViewType.CostReport:
			costReport.append(i.ToDSType(True))
		elif i.ViewType == ViewType.Detail:
			details.append(i.ToDSType(True))
		elif i.ViewType == ViewType.DraftingView:
			draftingViews.append(i.ToDSType(True))
		elif i.ViewType == ViewType.DrawingSheet:
			drawingSheets.append(i.ToDSType(True))
		elif i.ViewType == ViewType.Elevation:
			elevations.append(i.ToDSType(True))
		elif i.ViewType == ViewType.EngineeringPlan:
			engineetingPlans.append(i.ToDSType(True))
		elif i.ViewType == ViewType.FloorPlan:
			floorPlans.append(i.ToDSType(True))
		elif i.ViewType == ViewType.Internal:
			internal.append(i.ToDSType(True))
		elif i.ViewType == ViewType.Legend:
			legends.append(i.ToDSType(True))
		elif i.ViewType == ViewType.LoadsReport:
			loadReports.append(i.ToDSType(True))
		elif i.ViewType == ViewType.PanelSchedule:
			panelSchedules.append(i.ToDSType(True))
		elif i.ViewType == ViewType.PresureLossReport:
			pressureLossReports.append(i.ToDSType(True))
		elif i.ViewType == ViewType.Rendering:
			renderings.append(i.ToDSType(True))
		elif i.ViewType == ViewType.Report:
			reports.append(i.ToDSType(True))
		elif i.ViewType == ViewType.Schedule:
			schedules.append(i.ToDSType(True))
		elif i.ViewType == ViewType.Section:
			sections.append(i.ToDSType(True))
		elif i.ViewType == ViewType.ThreeD:
			threeD.append(i.ToDSType(True))
		elif i.ViewType == ViewType.Undefined:
			undefined.append(i.ToDSType(True))
		elif i.ViewType == ViewType.Walkthrough:
			walkthrough.append(i.ToDSType(True))
		else:
			continue

overrideplans = IN[0]
planscond = IN[1]
planname = IN[2].lower()

newfloorPlans = []
if overrideplans == True:
	for e in floorPlans:
		if planscond == 1:
			if e.Name.lower() == planname:
				newfloorPlans.append(e)
		elif planscond == 2:
			if planname in e.Name.lower():
				newfloorPlans.append(e)
		elif planscond == 3:
			newfloorPlans.append(e)

overrideceilings = IN[3]
ceilingscond = IN[4]
ceilingname = IN[5].lower()

newceilingPlans = []
if overrideceilings == True:
	for e in ceilingPlans:
		if ceilingscond == 1:
			if e.Name.lower() == ceilingname:
				newceilingPlans.append(e)
		elif ceilingscond == 2:
			if ceilingname in e.Name.lower():
				newceilingPlans.append(e)
		elif ceilingscond == 3:
			newceilingPlans.append(e)

overrideengineeting = IN[6]
engineetingscond = IN[7]
engineetingname = IN[8].lower()	

newengineetingPlans = []
if overrideengineeting == True:
	for e in engineetingPlans:
		if engineetingscond == 1:
			if e.Name.lower() == engineetingname:
				newengineetingPlans.append(e)
		elif engineetingscond == 2:
			if engineetingname in e.Name.lower():
				newengineetingPlans.append(e)
		elif engineetingscond == 3:
			newengineetingPlans.append(e)		
			
overridearea = IN[9]
areascond = IN[10]
areaname = IN[11].lower()	

newareaPlans = []
if overridearea == True:
	for e in areaPlans:
		if areascond == 1:
			if e.Name.lower() == areaname:
				newareaPlans.append(e)
		elif areascond == 2:
			if areaname in e.Name.lower():
				newareaPlans.append(e)
		elif areascond == 3:
			newareaPlans.append(e)

overrideelvs = IN[12]
elvsscond = IN[13]
elvsname = IN[14].lower()	

newelvs = []
if overrideelvs == True:
	for e in elevations:
		if elvsscond == 1:
			if e.Name.lower() == elvsname:
				newelvs.append(e)
		elif elvsscond == 2:
			if elvsname in e.Name.lower():
				newelvs.append(e)
		elif elvsscond == 3:
			newelvs.append(e)

overridesec = IN[15]
secscond = IN[16]
secsname = IN[17].lower()	

newsections = []
if overridesec == True:
	for e in sections:
		if secscond == 1:
			if e.Name.lower() == secsname:
				newsections.append(e)
		elif secscond == 2:
			if secsname in e.Name.lower():
				newsections.append(e)
		elif secscond == 3:
			newsections.append(e)
			
overridethreede = IN[18]
threedescond = IN[19]
threedename = IN[20].lower()	

newthreedes = []
if overridethreede == True:
	for e in threeD:
		if threedescond == 1:
			if e.Name.lower() == threedename:
				newthreedes.append(e)
		elif threedescond == 2:
			if threedename in e.Name.lower():
				newthreedes.append(e)
		elif threedescond == 3:
			newthreedes.append(e)
			
overridedet = IN[21]
detscond = IN[22]
detname = IN[23].lower()	

newdets = []
if overridedet == True:
	for e in details:
		if detscond == 1:
			if e.Name.lower() == detname:
				newdets.append(e)
		elif detscond == 2:
			if detname in e.Name.lower():
				newdets.append(e)
		elif detscond == 3:
			newdets.append(e)
			
'''
#Assign your output to the OUT variable
OUT = areaPlans, ceilingPlans, columnSchedules, costReport, \
	details, draftingViews, drawingSheets, elevations, \
	engineetingPlans, floorPlans, internal, legends, \
	loadReports, panelSchedules, pressureLossReports, \
	renderings, reports, schedules, sections, threeD, \
	undefined, walkthrough
'''

result = newfloorPlans + newceilingPlans + newengineetingPlans + newareaPlans + newelvs + newsections + newthreedes + newdets
OUT = result 
# ----------------------------------------
python_script_2 = Python(IN[0]=python_script, IN[1]=n01_mode_false_visible_elements)  # IronPython2
# ---------- python_script_2.python (94 lines) ----------
# Created By Karam Baki : karam@aecedx.com
# Enable Python support and load DesignScript library
# IMPORTANT : ALL DYNAMO DESIGN SCRIPT NODES ARE AS (dg)
import clr
import math
clr.AddReference('ProtoGeometry')
from Autodesk.DesignScript import Geometry as dg

# EXTENSION Enable ToDSType
clr.AddReference('RevitNodes')
import Revit
clr.ImportExtensions(Revit.Elements)

# Enable Revit Elements
from Revit.Elements import *

# EXTENSION Enable Geometry Conversion Methods
clr.ImportExtensions(Revit.GeometryConversion)

# Enable Revit API
clr.AddReference('RevitAPI')
from Autodesk.Revit.DB import *

# Enable DocumentManager and TransactionManager
clr.AddReference('RevitServices')
from RevitServices.Persistence import DocumentManager
from RevitServices.Transactions import TransactionManager

# Enable ICollection List Translate
clr.AddReference("System")
import System.Collections.Generic
from System.Collections.Generic import List
from itertools import compress
#The inputs to this node will be stored as a list in the IN variables.

doc = DocumentManager.Instance.CurrentDBDocument
uidoc = DocumentManager.Instance.CurrentUIApplication.ActiveUIDocument
uiapp = DocumentManager.Instance.CurrentUIApplication
app = uiapp.Application

def flatten(x):
    result = []
    for el in x:
        if hasattr(el, "__iter__") and not isinstance(el, basestring):
            result.extend(flatten(el))
        else:
            result.append(el)
    return result

allviews = UnwrapElement(IN[0])
mode = IN[1]

active = uidoc.ActiveView


graphsettings = []
TransactionManager.Instance.EnsureInTransaction(doc)

if mode == False:
	coll = FilteredElementCollector(doc,doc.ActiveView.Id)
	elems = coll
else:
	coll = FilteredElementCollector(doc)
	coll.WherePasses(ElementIsElementTypeFilter(True))
	elems = coll
	
idsofelems = []
for each in elems:
	idsofelems.append(each.Id)


bool_list = []
for each in idsofelems:
	try:
		graphsettings.append(active.GetElementOverrides(each))
		bool_list.append(True)
	except:
		bool_list.append(False)	

filteredelemens = list(compress(idsofelems, bool_list))

count = 0
for v in allviews:
	countin = 0
	for e in filteredelemens:
		try:
			v.SetElementOverrides(e, graphsettings[countin])
			countin = countin + 1
		except:
			countin = countin + 1
	count + 1
TransactionManager.Instance.TransactionTaskDone()

OUT = "DONE"
# ----------------------------------------
debug_python_no_message = Custom[Debug Python No Message]()  # package Synthesize toolkit; Debug Python
