# Dynamo graph Family.K-Override Smart Colors By Family and Type.dyn (Dynamo 2.13.1.3887)
# author: karam@aecedx.com
# packages: Synthesize toolkit 12.5.1

# group: Input
n02_all_elements_of_family_name = BoolSelector(true)  # "02.All Elements of Family Name (All types) ?"; graph input
n01_family_names_separate_by = StringInput("Family")  # "01.Family Names (Separate By Comma , - or * To Select All Matching)"; graph input
n03_specific_type_names_separate = StringInput("Type")  # "03.Specific Type Names (Separate by Comma , )"; graph input
n04_elements_in_active_view_only = BoolSelector(false)  # "04.Elements In Active View Only ?"; graph input
n17_try_to_detect_paint_materials = BoolSelector(false)  # "17.Try to Detect Paint Materials Instead"; graph input
n14_is_type_parameter_for = BoolSelector(true)  # "14.Is Type Parameter (For Loadable) ?"; graph input
n13_material_parameter_for = StringInput("Material")  # "13.Material Parameter For Loadable Families"; graph input
n16_is_type_parameter_for_system = BoolSelector(true)  # "16.Is Type Parameter (For System) ?"; graph input
n15_material_parameter_for_system = StringInput("Structural Material")  # "15.Material Parameter For System Families"; graph input
n07_override_cut_fill_colors = BoolSelector(false)  # "07.Override Cut Fill Colors ?"; graph input
n08_force_cut_fill_color_with = BoolSelector(false)  # "08.Force Cut Fill Color With Black ?"; graph input
n05_override_projection_fill = BoolSelector(true)  # "05.Override Projection Fill Colors ?"; graph input
n11_override_cut_lines_color = BoolSelector(false)  # "11.Override Cut Lines Color ?"; graph input
n10_override_projection_lines = BoolSelector(false)  # "10.Override Projection Lines Color ?"; graph input
n09_cut_pattern = FillPatterns("<Solid fill>")  # "09.Cut Pattern"; graph input
n06_projection_pattern = FillPatterns("<Solid fill>")  # "06.Projection Pattern"; graph input
n12_force_transparancy_value_0 = BoolSelector(true)  # "12.Force Transparancy Value 0 ?"; graph input

code_block = CodeBlock { ","; }
family_and_type_selector = Custom[Family and Type Selector](VARAllElementsofFamilyNameAlltypes=n02_all_elements_of_family_name, VARFamilyName=n01_family_names_separate_by, VARSpecificTypeNamesSeparatebySymbol=n03_specific_type_names_separate, VARSeparationSymbol=code_block, VAROnlyInActiveView=n04_elements_in_active_view_only)  # package Synthesize toolkit; Family and Type Selector
bk_get_categories_from_elements = Custom[BK.Get Categories from Elements](VARElements=family_and_type_selector.VARElements)  # package Synthesize toolkit; "List Unique Categories Present in Set of Elements" is better. This one uses Blackbox Get.CategoryName and Get Categories (designed to use document category list)
bk_get_system_type_list_by = Custom[BK.Get System Type List by Category Name](VARcategoryName=bk_get_categories_from_elements.VARCategoriesPresent@L1)  # package Synthesize toolkit; takes category name as string
code_block_2 = CodeBlock { false; }
clean = List.Clean(list=bk_get_system_type_list_by, preserveIndices=code_block_2)
flatten = List.Flatten(list=clean)
elementType = Element.ElementType(element=family_and_type_selector.VARElements)
contains = List.Contains(list=flatten@L1, item=elementType, lacing=CrossProduct)
count = List.Count(list=contains)
ofRepeatedItem = List.OfRepeatedItem(item=family_and_type_selector.VARElements, amount=count)
filterByBoolMask = List.FilterByBoolMask(list=ofRepeatedItem, mask=contains)
flatten_2 = List.Flatten(list=filterByBoolMask.in)
removeListFromList = Custom[RH.RemoveListFromList](VARListA=family_and_type_selector.VARElements, VARListB=flatten_2)  # package Synthesize toolkit; This node essentially "subtracts" the contents of List B from List A to produce a new list with the unique items.
turnIntoList = Custom[CW.TurnIntoList](VARunknownItem=removeListFromList)  # package Synthesize toolkit; Turns an element (or a nested list) into a flat list
python_script = Python(IN[0]=removeListFromList)  # IronPython2
# ---------- python_script.python (13 lines) ----------
import clr
clr.AddReference('ProtoGeometry')
from Autodesk.DesignScript.Geometry import *
#The inputs to this node will be stored as a list in the IN variables.
dataEnteringNode = IN

if IN[0] > 0:
	output = []
	for i in range(IN[0]):
		output.append(None)
	OUT = output
else:
	OUT = []
# ----------------------------------------
materials = Custom[CW.Element.Materials](VARelement=removeListFromList, VARreturnPaintMaterials=n17_try_to_detect_paint_materials)  # package Synthesize toolkit; Retrieves all materials from a given element
code_block_3 = CodeBlock { false; }
eq = materials.VARhasMaterial == code_block_3
filterByBoolMask_2 = List.FilterByBoolMask(list=python_script, mask=eq)
filterByBoolMask_3 = List.FilterByBoolMask(list=materials.VARmaterials, mask=eq)
filterByBoolMask_4 = List.FilterByBoolMask(list=materials.VARmaterialAreas, mask=eq)
maximumItem = List.MaximumItem(list=filterByBoolMask_4.out)
eq_2 = filterByBoolMask_4.out == maximumItem
filterByBoolMask_5 = List.FilterByBoolMask(list=filterByBoolMask_3.out, mask=eq_2)
firstItem = List.FirstItem(list=filterByBoolMask_5.in@L2)
mergeByBoolMask = Custom[SP.List.MergeByBoolMask](VARIn=filterByBoolMask_2.in, VAROut=firstItem, VARmask=eq)  # package Synthesize toolkit; Merge two lists by a boolean mask list. The true count in the mask should be the same as the length of the true list and vice versa for the false list.
code_block_4 = CodeBlock { ""; }
familyType = Custom[AL.FamilyInstance.FamilyType](VARFamilyInstance=removeListFromList)  # package Synthesize toolkit; This node will return a Family Type of a given Family Instance. If no Family Type can be assigned to a Family then it will return Null.
scopeIf = Custom[CW.ScopeIf+](VARtest=n14_is_type_parameter_for, VARtrue=familyType, VARfalse=removeListFromList)  # package Synthesize toolkit; A (hopefully) more robust implementation of ScopeIf. Tests a single boolean and returns a value accordingly.
create = List.Create(item0=scopeIf)
getParameterValueByName = Element.GetParameterValueByName(parameterName=n13_material_parameter_for)  # unwired: element
map = List.Map(list=create, f_x=getParameterValueByName)
flatten_3 = List.Flatten(list=map)
string_from_object = FromObject(obj=flatten_3)
eq_3 = code_block_4 == string_from_object
filterByBoolMask_6 = List.FilterByBoolMask(list=mergeByBoolMask, mask=eq_3)
filterByBoolMask_7 = List.FilterByBoolMask(list=flatten_3, mask=eq_3)
mergeByBoolMask_2 = Custom[SP.List.MergeByBoolMask](VARIn=filterByBoolMask_6.in, VAROut=filterByBoolMask_7.out, VARmask=eq_3)
string_from_object_2 = FromObject(obj=mergeByBoolMask_2)
code_block_5 = CodeBlock { "<By Category>"; }
eq_4 = string_from_object_2 == code_block_5
filterByBoolMask_8 = List.FilterByBoolMask(list=mergeByBoolMask, mask=eq_4)
filterByBoolMask_9 = List.FilterByBoolMask(list=mergeByBoolMask_2, mask=eq_4)
mergeByBoolMask_3 = Custom[SP.List.MergeByBoolMask](VARIn=filterByBoolMask_8.in, VAROut=filterByBoolMask_9.out, VARmask=eq_4)
isNull = Object.IsNull(object=mergeByBoolMask_3)
filterByBoolMask_10 = List.FilterByBoolMask(list=turnIntoList, mask=isNull)
getMaterials = Element.GetMaterials(element=flatten_2, paintMaterials=n17_try_to_detect_paint_materials)
firstItem_2 = List.FirstItem()  # unwired: list
map_2 = List.Map(list=getMaterials, f_x=firstItem_2)
code_block_6 = CodeBlock { ""; }
familyType_2 = Custom[AL.FamilyInstance.FamilyType](VARFamilyInstance=flatten_2)
scopeIf_2 = Custom[CW.ScopeIf+](VARtest=n16_is_type_parameter_for_system, VARtrue=familyType_2, VARfalse=flatten_2)
getParameterValueByName_2 = Element.GetParameterValueByName(element=scopeIf_2, parameterName=n15_material_parameter_for_system)
string_from_object_3 = FromObject(obj=getParameterValueByName_2)
eq_5 = code_block_6 == string_from_object_3
filterByBoolMask_11 = List.FilterByBoolMask(list=map_2, mask=eq_5)
filterByBoolMask_12 = List.FilterByBoolMask(list=getParameterValueByName_2, mask=eq_5)
mergeByBoolMask_4 = Custom[SP.List.MergeByBoolMask](VARIn=filterByBoolMask_11.in, VAROut=filterByBoolMask_12.out, VARmask=eq_5)
string_from_object_4 = FromObject(obj=mergeByBoolMask_4)
code_block_7 = CodeBlock { "<By Category>"; }
eq_6 = string_from_object_4 == code_block_7
filterByBoolMask_13 = List.FilterByBoolMask(list=map_2, mask=eq_6)
filterByBoolMask_14 = List.FilterByBoolMask(list=mergeByBoolMask_4, mask=eq_6)
mergeByBoolMask_5 = Custom[SP.List.MergeByBoolMask](VARIn=filterByBoolMask_13.in, VAROut=filterByBoolMask_14.out, VARmask=eq_6)
isNull_2 = Object.IsNull(object=mergeByBoolMask_5)
filterByBoolMask_15 = List.FilterByBoolMask(list=flatten_2, mask=isNull_2)
join = List.Join(list0=filterByBoolMask_10.out, list1=filterByBoolMask_15.out)
code_block_8 = CodeBlock { 255; 0; }
byARGB = Color.ByARGB(alpha=code_block_8.out0, red=code_block_8.out1, green=code_block_8.out1, blue=code_block_8.out1)
filterByBoolMask_16 = List.FilterByBoolMask(list=mergeByBoolMask_3, mask=isNull)
filterByBoolMask_17 = List.FilterByBoolMask(list=mergeByBoolMask_5, mask=isNull_2)
join_2 = List.Join(list0=filterByBoolMask_16.out, list1=filterByBoolMask_17.out)
name = Material.Name(material=join_2)
byName = Material.ByName(name=name)
color = Material.Color(material=byName)
count_2 = List.Count(list=color)
cycle = List.Cycle(list=byARGB, amount=count_2)
scopeIf_3 = Custom[CW.ScopeIf+](VARtest=n08_force_cut_fill_color_with, VARtrue=cycle, VARfalse=color)
code_block_9 = CodeBlock { null; }
scopeIf_4 = Custom[CW.ScopeIf+](VARtest=n07_override_cut_fill_colors, VARtrue=scopeIf_3, VARfalse=code_block_9)
python_empty_2_null = Custom[Python Empty 2 Null](VARIN=scopeIf_4)  # package Synthesize toolkit; Python Null 2 Empty
code_block_10 = CodeBlock { null; }
scopeIf_5 = Custom[CW.ScopeIf+](VARtest=n05_override_projection_fill, VARtrue=color, VARfalse=code_block_10)
python_empty_2_null_2 = Custom[Python Empty 2 Null](VARIN=scopeIf_5)
code_block_11 = CodeBlock { null; }
scopeIf_6 = Custom[CW.ScopeIf+](VARtest=n11_override_cut_lines_color, VARtrue=color, VARfalse=code_block_11)
python_empty_2_null_3 = Custom[Python Empty 2 Null](VARIN=scopeIf_6)
scopeIf_7 = Custom[CW.ScopeIf+](VARtest=n10_override_projection_lines, VARtrue=color, VARfalse=code_block_11)
python_empty_2_null_4 = Custom[Python Empty 2 Null](VARIN=scopeIf_7)
code_block_12 = CodeBlock { null; }
scopeIf_8 = Custom[CW.ScopeIf+](VARtest=n07_override_cut_fill_colors, VARtrue=n09_cut_pattern, VARfalse=code_block_12)
python_empty_2_null_5 = Custom[Python Empty 2 Null](VARIN=scopeIf_8)
scopeIf_9 = Custom[CW.ScopeIf+](VARtest=n05_override_projection_fill, VARtrue=n06_projection_pattern, VARfalse=code_block_10)
python_empty_2_null_6 = Custom[Python Empty 2 Null](VARIN=scopeIf_9)
code_block_13 = CodeBlock { 0; }
cycle_2 = List.Cycle(list=code_block_13, amount=count_2)
transparency = Material.Transparency(material=byName)
scopeIf_10 = Custom[CW.ScopeIf+](VARtest=n12_force_transparancy_value_0, VARtrue=cycle_2, VARfalse=transparency)
python_empty_2_null_7 = Custom[Python Empty 2 Null](VARIN=scopeIf_10)
byProperties = Revit.Filter.OverrideGraphicSettings.ByProperties(cutFillColor=python_empty_2_null, projectionFillColor=python_empty_2_null_2, cutLineColor=python_empty_2_null_3, projectionLineColor=python_empty_2_null_4, cutFillPattern=python_empty_2_null_5, projectionFillPattern=python_empty_2_null_6, transparency=python_empty_2_null_7, lacing=Longest)
overrideInView = Element.OverrideInView(element=join, overrides=byProperties)
count_3 = List.Count(list=overrideInView)

# group: Report
n01_number_of_selected_elements = Watch(count_3)  # "01.Number of Selected Elements"; graph output

debug_python = Custom[Debug Python]()  # package Synthesize toolkit; Debug Python
