# Dynamo graph Family.K-Override Smart Colors By Selection Filter.dyn (Dynamo 2.13.1.3887)
# author: karam@aecedx.com
# packages: Synthesize toolkit 12.5.1

hot_get_all_filter = Custom[HOT.Get All Filter]()  # package Synthesize toolkit; Get all Filter
toLower = String.ToLower(string=hot_get_all_filter.VARName)
trimWhitespace = String.TrimWhitespace(string=toLower)

# group: Input
n01_selection_filter_to_read = StringInput("Selection Filter")  # "01.Selection Filter to Read"; graph input
n14_try_to_detect_paint_materials = BoolSelector(false)  # "14.Try to Detect Paint Materials Instead"; graph input
n11_is_type_parameter_for = BoolSelector(true)  # "11.Is Type Parameter (For Loadable) ?"; graph input
n10_material_parameter_for = StringInput("Material")  # "10.Material Parameter For Loadable Families"; graph input
n13_is_type_parameter_for_system = BoolSelector(true)  # "13.Is Type Parameter (For System) ?"; graph input
n12_material_parameter_for_system = StringInput("Structural Material")  # "12.Material Parameter For System Families"; graph input
n04_override_cut_fill_colors = BoolSelector(false)  # "04.Override Cut Fill Colors ?"; graph input
n05_force_cut_fill_color_with = BoolSelector(false)  # "05.Force Cut Fill Color With Black ?"; graph input
n02_override_projection_fill = BoolSelector(true)  # "02.Override Projection Fill Colors ?"; graph input
n08_override_cut_lines_color = BoolSelector(false)  # "08.Override Cut Lines Color ?"; graph input
n07_override_projection_lines = BoolSelector(false)  # "07.Override Projection Lines Color ?"; graph input
n06_cut_pattern = FillPatterns("<Solid fill>")  # "06.Cut Pattern"; graph input
n03_projection_pattern = FillPatterns("<Solid fill>")  # "03.Projection Pattern"; graph input
n09_force_transparancy_value_0 = BoolSelector(true)  # "09.Force Transparancy Value 0 ?"; graph input

toLower_2 = String.ToLower(string=n01_selection_filter_to_read)
trimWhitespace_2 = String.TrimWhitespace(string=toLower_2)
eq = trimWhitespace == trimWhitespace_2
filterByBoolMask = List.FilterByBoolMask(list=hot_get_all_filter.VARElement, mask=eq)
elements = Custom[CW.SelectionSet.Elements](VARselectionSet=filterByBoolMask.in)  # package Synthesize toolkit; Retrieves all elements stored in a selection set
flatten = List.Flatten(list=elements)
boolean = BoolSelector(false)
clean = List.Clean(list=flatten, preserveIndices=boolean)
flatten_2 = List.Flatten(list=clean)
bk_get_categories_from_elements = Custom[BK.Get Categories from Elements](VARElements=flatten_2)  # package Synthesize toolkit; "List Unique Categories Present in Set of Elements" is better. This one uses Blackbox Get.CategoryName and Get Categories (designed to use document category list)
bk_get_system_type_list_by = Custom[BK.Get System Type List by Category Name](VARcategoryName=bk_get_categories_from_elements.VARCategoriesPresent@L1)  # package Synthesize toolkit; takes category name as string
code_block = CodeBlock { false; }
clean_2 = List.Clean(list=bk_get_system_type_list_by, preserveIndices=code_block)
flatten_3 = List.Flatten(list=clean_2)
elementType = Element.ElementType(element=flatten_2)
contains = List.Contains(list=flatten_3@L1, item=elementType, lacing=CrossProduct)
count = List.Count(list=contains)
ofRepeatedItem = List.OfRepeatedItem(item=flatten_2, amount=count)
filterByBoolMask_2 = List.FilterByBoolMask(list=ofRepeatedItem, mask=contains)
flatten_4 = List.Flatten(list=filterByBoolMask_2.in)
removeListFromList = Custom[RH.RemoveListFromList](VARListA=flatten_2, VARListB=flatten_4)  # package Synthesize toolkit; This node essentially "subtracts" the contents of List B from List A to produce a new list with the unique items.
turnIntoList = Custom[CW.TurnIntoList](VARunknownItem=removeListFromList)  # package Synthesize toolkit; Turns an element (or a nested list) into a flat list
python_script = Python(IN[0]=removeListFromList)  # IronPython2
# ---------- python_script.python (13 lines) ----------
import clr
clr.AddReference('ProtoGeometry')
from Autodesk.DesignScript.Geometry import *
#The inputs to this node will be stored as a list in the IN variables.
dataEnteringNode = IN

if IN[0] > 0:
	output = []
	for i in range(IN[0]):
		output.append(None)
	OUT = output
else:
	OUT = []
# ----------------------------------------
materials = Custom[CW.Element.Materials](VARelement=removeListFromList, VARreturnPaintMaterials=n14_try_to_detect_paint_materials)  # package Synthesize toolkit; Retrieves all materials from a given element
code_block_2 = CodeBlock { false; }
eq_2 = materials.VARhasMaterial == code_block_2
filterByBoolMask_3 = List.FilterByBoolMask(list=python_script, mask=eq_2)
filterByBoolMask_4 = List.FilterByBoolMask(list=materials.VARmaterials, mask=eq_2)
filterByBoolMask_5 = List.FilterByBoolMask(list=materials.VARmaterialAreas, mask=eq_2)
maximumItem = List.MaximumItem(list=filterByBoolMask_5.out)
eq_3 = filterByBoolMask_5.out == maximumItem
filterByBoolMask_6 = List.FilterByBoolMask(list=filterByBoolMask_4.out, mask=eq_3)
firstItem = List.FirstItem(list=filterByBoolMask_6.in@L2)
mergeByBoolMask = Custom[SP.List.MergeByBoolMask](VARIn=filterByBoolMask_3.in, VAROut=firstItem, VARmask=eq_2)  # package Synthesize toolkit; Merge two lists by a boolean mask list. The true count in the mask should be the same as the length of the true list and vice versa for the false list.
code_block_3 = CodeBlock { ""; }
familyType = Custom[AL.FamilyInstance.FamilyType](VARFamilyInstance=removeListFromList)  # package Synthesize toolkit; This node will return a Family Type of a given Family Instance. If no Family Type can be assigned to a Family then it will return Null.
scopeIf = Custom[CW.ScopeIf+](VARtest=n11_is_type_parameter_for, VARtrue=familyType, VARfalse=removeListFromList)  # package Synthesize toolkit; A (hopefully) more robust implementation of ScopeIf. Tests a single boolean and returns a value accordingly.
create = List.Create(item0=scopeIf)
getParameterValueByName = Element.GetParameterValueByName(parameterName=n10_material_parameter_for)  # unwired: element
map = List.Map(list=create, f_x=getParameterValueByName)
flatten_5 = List.Flatten(list=map)
string_from_object = FromObject(obj=flatten_5)
eq_4 = code_block_3 == string_from_object
filterByBoolMask_7 = List.FilterByBoolMask(list=mergeByBoolMask, mask=eq_4)
filterByBoolMask_8 = List.FilterByBoolMask(list=flatten_5, mask=eq_4)
mergeByBoolMask_2 = Custom[SP.List.MergeByBoolMask](VARIn=filterByBoolMask_7.in, VAROut=filterByBoolMask_8.out, VARmask=eq_4)
string_from_object_2 = FromObject(obj=mergeByBoolMask_2)
code_block_4 = CodeBlock { "<By Category>"; }
eq_5 = string_from_object_2 == code_block_4
filterByBoolMask_9 = List.FilterByBoolMask(list=mergeByBoolMask, mask=eq_5)
filterByBoolMask_10 = List.FilterByBoolMask(list=mergeByBoolMask_2, mask=eq_5)
mergeByBoolMask_3 = Custom[SP.List.MergeByBoolMask](VARIn=filterByBoolMask_9.in, VAROut=filterByBoolMask_10.out, VARmask=eq_5)
isNull = Object.IsNull(object=mergeByBoolMask_3)
filterByBoolMask_11 = List.FilterByBoolMask(list=turnIntoList, mask=isNull)
getMaterials = Element.GetMaterials(element=flatten_4, paintMaterials=n14_try_to_detect_paint_materials)
firstItem_2 = List.FirstItem()  # unwired: list
map_2 = List.Map(list=getMaterials, f_x=firstItem_2)
code_block_5 = CodeBlock { ""; }
familyType_2 = Custom[AL.FamilyInstance.FamilyType](VARFamilyInstance=flatten_4)
scopeIf_2 = Custom[CW.ScopeIf+](VARtest=n13_is_type_parameter_for_system, VARtrue=familyType_2, VARfalse=flatten_4)
getParameterValueByName_2 = Element.GetParameterValueByName(element=scopeIf_2, parameterName=n12_material_parameter_for_system)
string_from_object_3 = FromObject(obj=getParameterValueByName_2)
eq_6 = code_block_5 == string_from_object_3
filterByBoolMask_12 = List.FilterByBoolMask(list=map_2, mask=eq_6)
filterByBoolMask_13 = List.FilterByBoolMask(list=getParameterValueByName_2, mask=eq_6)
mergeByBoolMask_4 = Custom[SP.List.MergeByBoolMask](VARIn=filterByBoolMask_12.in, VAROut=filterByBoolMask_13.out, VARmask=eq_6)
string_from_object_4 = FromObject(obj=mergeByBoolMask_4)
code_block_6 = CodeBlock { "<By Category>"; }
eq_7 = string_from_object_4 == code_block_6
filterByBoolMask_14 = List.FilterByBoolMask(list=map_2, mask=eq_7)
filterByBoolMask_15 = List.FilterByBoolMask(list=mergeByBoolMask_4, mask=eq_7)
mergeByBoolMask_5 = Custom[SP.List.MergeByBoolMask](VARIn=filterByBoolMask_14.in, VAROut=filterByBoolMask_15.out, VARmask=eq_7)
isNull_2 = Object.IsNull(object=mergeByBoolMask_5)
filterByBoolMask_16 = List.FilterByBoolMask(list=flatten_4, mask=isNull_2)
join = List.Join(list0=filterByBoolMask_11.out, list1=filterByBoolMask_16.out)
code_block_7 = CodeBlock { 255; 0; }
byARGB = Color.ByARGB(alpha=code_block_7.out0, red=code_block_7.out1, green=code_block_7.out1, blue=code_block_7.out1)
filterByBoolMask_17 = List.FilterByBoolMask(list=mergeByBoolMask_3, mask=isNull)
filterByBoolMask_18 = List.FilterByBoolMask(list=mergeByBoolMask_5, mask=isNull_2)
join_2 = List.Join(list0=filterByBoolMask_17.out, list1=filterByBoolMask_18.out)
name = Material.Name(material=join_2)
byName = Material.ByName(name=name)
color = Material.Color(material=byName)
count_2 = List.Count(list=color)
cycle = List.Cycle(list=byARGB, amount=count_2)
scopeIf_3 = Custom[CW.ScopeIf+](VARtest=n05_force_cut_fill_color_with, VARtrue=cycle, VARfalse=color)
code_block_8 = CodeBlock { null; }
scopeIf_4 = Custom[CW.ScopeIf+](VARtest=n04_override_cut_fill_colors, VARtrue=scopeIf_3, VARfalse=code_block_8)
python_empty_2_null = Custom[Python Empty 2 Null](VARIN=scopeIf_4)  # package Synthesize toolkit; Python Null 2 Empty
code_block_9 = CodeBlock { null; }
scopeIf_5 = Custom[CW.ScopeIf+](VARtest=n02_override_projection_fill, VARtrue=color, VARfalse=code_block_9)
python_empty_2_null_2 = Custom[Python Empty 2 Null](VARIN=scopeIf_5)
code_block_10 = CodeBlock { null; }
scopeIf_6 = Custom[CW.ScopeIf+](VARtest=n08_override_cut_lines_color, VARtrue=color, VARfalse=code_block_10)
python_empty_2_null_3 = Custom[Python Empty 2 Null](VARIN=scopeIf_6)
scopeIf_7 = Custom[CW.ScopeIf+](VARtest=n07_override_projection_lines, VARtrue=color, VARfalse=code_block_10)
python_empty_2_null_4 = Custom[Python Empty 2 Null](VARIN=scopeIf_7)
code_block_11 = CodeBlock { null; }
scopeIf_8 = Custom[CW.ScopeIf+](VARtest=n04_override_cut_fill_colors, VARtrue=n06_cut_pattern, VARfalse=code_block_11)
python_empty_2_null_5 = Custom[Python Empty 2 Null](VARIN=scopeIf_8)
scopeIf_9 = Custom[CW.ScopeIf+](VARtest=n02_override_projection_fill, VARtrue=n03_projection_pattern, VARfalse=code_block_9)
python_empty_2_null_6 = Custom[Python Empty 2 Null](VARIN=scopeIf_9)
code_block_12 = CodeBlock { 0; }
cycle_2 = List.Cycle(list=code_block_12, amount=count_2)
transparency = Material.Transparency(material=byName)
scopeIf_10 = Custom[CW.ScopeIf+](VARtest=n09_force_transparancy_value_0, VARtrue=cycle_2, VARfalse=transparency)
python_empty_2_null_7 = Custom[Python Empty 2 Null](VARIN=scopeIf_10)
byProperties = Revit.Filter.OverrideGraphicSettings.ByProperties(cutFillColor=python_empty_2_null, projectionFillColor=python_empty_2_null_2, cutLineColor=python_empty_2_null_3, projectionLineColor=python_empty_2_null_4, cutFillPattern=python_empty_2_null_5, projectionFillPattern=python_empty_2_null_6, transparency=python_empty_2_null_7, lacing=Longest)
overrideInView = Element.OverrideInView(element=join, overrides=byProperties)
count_3 = List.Count(list=overrideInView)

# group: Report
n01_number_of_selected_elements = Watch(count_3)  # "01.Number of Selected Elements"; graph output

debug_python = Custom[Debug Python]()  # package Synthesize toolkit; Debug Python
