# Dynamo graph Family.K-Paneling Frame.dyn (Dynamo 2.13.1.3887)
# author: karam@aecedx.com
# packages: Synthesize toolkit 12.5.1

# group: Input
n02_fetch_whole_body = BoolSelector(false)  # "02.Fetch Whole Body ?"; graph input
n01_select_faces = SelectFaces()  # "01.Select Faces"; nothing selected; graph input
n03_faces_filter_1_vertical_faces = IntegerSlider(4, range=1..4 step 1)  # "03.Faces Filter (1 = Vertical Faces | 2 = Horizontal Up Faces | 3 = Horizontal Down Faces | 4 = All Faces)"; graph input
n04_faces_offset = DoubleInput(0)  # "04.Faces Offset"; graph input
n15_re_loft_faces_distancing = DoubleInput(2)  # "15.Re-Loft Faces : Distancing"; graph input
n13_re_loft_faces = BoolSelector(false)  # "13.Re-Loft Faces ?"; graph input
n14_re_loft_faces_flip_direction = BoolSelector(false)  # "14.Re-Loft Faces : Flip Direction ?"; graph input
n16_normalize_quad_faces = BoolSelector(false)  # "16.Normalize Quad Faces ?"; graph input
n06_border_depth = DoubleInput(0.2)  # "06.Border Depth"; graph input
n05_border_width = DoubleInput(0.1)  # "05.Border Width"; graph input
n10_family_name = StringInput("Dynamo K-Paneling")  # "10.Family Name"; graph input
category = Categories("OST_GenericModel")  # "11.Category"; graph input
n12_family_template_of_the_above = Filename("..\..\..\..\..\..\..\..\..\..\ProgramData\Autodesk\RVT 2020\Family Templates\English\Metric Generic Model.rft")  # "12.Family Template of The Above Category"; graph input
n07_frame_material = StringInput("Aluminum")  # "07.Frame Material"; graph input
n09_material_single_parameter = BoolSelector(false)  # "09.Material: Single Parameter Only ?"; graph input
n08_material_is_instance = BoolSelector(true)  # "08.Material: Is Instance Parameter ?"; graph input

code_block = CodeBlock { true; }
ne = n02_fetch_whole_body != code_block
fetch_whole_body = Custom[Fetch Whole Body](VARFetchorNot=n02_fetch_whole_body, VARSurfaces=n01_select_faces)  # package Synthesize toolkit; Fetch Whole Body
surface_importer_2x = Custom[Surface Importer 2x](VAROperate=ne, VARSurfaces=fetch_whole_body)  # package Synthesize toolkit; Surface Importer Updated
flatten = List.Flatten(list=surface_importer_2x)
surface_orientation_filter = Custom[Surface Orientation Filter](VARSurfaces=flatten, VAROrienataion=n03_faces_filter_1_vertical_faces)  # package Synthesize toolkit; Face Filter
smart_surface_offset_with_reloft = Custom[Smart Surface Offset With Reloft](VARSurfaces=surface_orientation_filter.VARSurfaces, VARDistances=n04_faces_offset, VARReloftDistancing=n15_re_loft_faces_distancing, VARPerformReloft=n13_re_loft_faces, VARFlipBalancingDirection=n14_re_loft_faces_flip_direction)  # package Synthesize toolkit; Smart Surface Offset With Reloft
understand_quad_faces = Custom[Understand Quad Faces](VARSurfaces=smart_surface_offset_with_reloft.VARSurfaces, VARUnderstandorNot=n16_normalize_quad_faces)  # package Synthesize toolkit; Try to Normalize Faces
safe_thicken_factor_in_feet = DoubleInput(1.65)
k_paneling_framing_only = Custom[K-Paneling Framing Only](VARSuraces=understand_quad_faces, VARFrameDepth=n06_border_depth, VARFrameWidth=n05_border_width, VARSafeThickenFactor=safe_thicken_factor_in_feet)  # package Synthesize toolkit; Create Frames By Surfaces
code_block_2 = CodeBlock(a=n10_family_name) { a + " Frame"; }
smart_rft_path = Custom[Smart RFT Path](VARRFTFile=n12_family_template_of_the_above, VARCategory=category)  # package Synthesize toolkit; Smart RFT Path
k_family_insert = Custom[K-Family Insert](VARGeometryorSAT=k_paneling_framing_only.VARFrameSolids, VARFamilyName=code_block_2, VARFamilyCategory=category, VARFamilyTemplatePath=smart_rft_path, VARMaterialName=n07_frame_material, VARIsOneMaterial=n09_material_single_parameter, VARIsMaterialInstance=n08_material_is_instance)  # package Synthesize toolkit; K-Family Insert
debug_python_no_message = Custom[Debug Python No Message]()  # package Synthesize toolkit; Debug Python
