# Dynamo graph Family.K-Rigger By Families - Multiple Selection.dyn (Dynamo 2.13.1.3887)
# author: karam@aecedx.com
# packages: Synthesize toolkit 12.5.1

# group: Input
n01_select_families = DSModelElementsSelection()  # "01.Select Families"; nothing selected; graph input
n02_mode_1_default_2_workplane = IntegerSlider(1, range=1..3 step 1)  # "02.Mode: 1 = Default | 2 = Workplane Mode | 3 = Adaptive Family Mode"; graph input
n09_generic_family_template = Filename("..\..\..\ProgramData\Autodesk\RVT 2020\Family Templates\English\Metric Generic Model.rft")  # "09.Generic Family Template"; graph input
n10_adaptive_family_template = Filename("..\..\..\ProgramData\Autodesk\RVT 2020\Family Templates\English\Metric Generic Model Adaptive.rft")  # "10.Adaptive Family Template"; graph input
n06_instance_height_parameter = BoolSelector(true)  # "06.Instance Height Parameter ?"; graph input
n07_overwrite_parameters_if = BoolSelector(true)  # "07.Overwrite Parameters If Rigged Family Already Loaded ?"; graph input
n08_name_separator = StringInput("_")  # "08.Name Separator"; graph input
n03_host_width_if_found_0_will = DoubleInput(0)  # "03.Host Width If Found (0 Will Use Default)"; graph input
n04_custom_safe_height_0_will_not = DoubleInput(0)  # "04.Custom Safe Height (0 Will Not Place Invisible Line)"; graph input
n05_custom_safe_height_additive = BoolSelector(false)  # "05.Custom Safe Height: Additive ?"; graph input

python_script = Python(IN[0]=n01_select_families)  # IronPython2
# ---------- python_script.python (41 lines) ----------
import clr
clr.AddReference('ProtoGeometry')
from Autodesk.DesignScript.Geometry import *
#The inputs to this node will be stored as a list in the IN variables.
dataEnteringNode = IN

def tolist(obj1):
	if hasattr(obj1,'__iter__'): return obj1
	else: return [obj1]

def uniqueIndexes(l):
    seen = set()
    res = []
    for i, n in enumerate(l):
        if n not in seen:
            res.append(i)
            seen.add(n)
    return res

sourceinstances = UnwrapElement(tolist(IN[0]))
cleaninstances = []
types = []
for sourceinstance in sourceinstances:
	famtypename = sourceinstance.Symbol.GetParameters("Type Name")[0].AsString()
	nametotest = famtypename.lower()
	if "rigged" in nametotest:
		continue
	else:
		cleaninstances.append(sourceinstance)
		types.append(famtypename)
unique = uniqueIndexes(types)

result = []
count = 0
for cleaninstance in cleaninstances:
	if count in unique:
		result.append(cleaninstance)
	count += 1

#Assign your output to the OUT variable.
OUT = result
# ----------------------------------------
python_script_2 = Python(IN[0]=n02_mode_1_default_2_workplane)  # IronPython2
# ---------- python_script_2.python (16 lines) ----------
import clr
clr.AddReference('ProtoGeometry')
from Autodesk.DesignScript.Geometry import *
#The inputs to this node will be stored as a list in the IN variables.
dataEnteringNode = IN

test = IN[0]

if test == 1:
	OUT = False,False
elif test == 2:
	OUT = False,True
elif test == 3:
	OUT = True,True
else:
	OUT = False,False
# ----------------------------------------
code_block = CodeBlock(a=python_script_2) { a[0]; a[1]; }
smart_rft_path = Custom[Smart RFT Path](VARRFTFile=n09_generic_family_template)  # package Synthesize toolkit; Smart RFT Path
categories = Categories("OST_AdaptivePoints")
smart_rft_path_2 = Custom[Smart RFT Path](VARRFTFile=n10_adaptive_family_template, VARCategory=categories)
k_rig_family = Custom[K-Rig Family](VARFamilyInstance=python_script@L1, VARAdaptiveMode=code_block.out0, VARFamilyTemplate=smart_rft_path, VARAdaptiveFamilyTemplate=smart_rft_path_2, VARHeightInstanceParameter=n06_instance_height_parameter, VAROverwriteParameters=n07_overwrite_parameters_if, VARSeparators=n08_name_separator, VARInitialHostWidth=n03_host_width_if_found_0_will, VARForceWorkPlaneBased=code_block.out1, VARSafeHeight=n04_custom_safe_height_0_will_not, VARAdditiveSafeHeight=n05_custom_safe_height_additive)  # package Synthesize toolkit; K-Rig Family
debug_python_no_message = Custom[Debug Python No Message]()  # package Synthesize toolkit; Debug Python
