# Dynamo graph Family.K-Unhoster By Families - Multiple Selection.dyn (Dynamo 2.13.1.3887)
# author: karam@aecedx.com
# packages: Synthesize toolkit 12.5.1

debug_python_no_message = Custom[Debug Python No Message]()  # package Synthesize toolkit; Debug Python

# group: Input
n01_select_families = DSModelElementsSelection()  # "01.Select Families"; nothing selected; graph input
n06_family_template_rft_generic = Filename("..\..\..\ProgramData\Autodesk\RVT 2020\Family Templates\English\Metric Generic Model.rft")  # "06.Family Template .RFT (Generic Model Recommended)"; graph input
n04_overwrite_parameters_if = BoolSelector(true)  # "04.Overwrite Parameters If Unhosted Families Already Loaded ?"; graph input
n05_name_separator = StringInput("_")  # "05.Name Separator"; graph input
n03_host_width_if_found_0_will = DoubleInput(0)  # "03.Host Width If Found (0 Will Use Default)"; graph input
n02_force_workplane = BoolSelector(false)  # "02.Force Workplane ?"; graph input

python_script = Python(IN[0]=n01_select_families)  # IronPython2
# ---------- python_script.python (41 lines) ----------
import clr
clr.AddReference('ProtoGeometry')
from Autodesk.DesignScript.Geometry import *
#The inputs to this node will be stored as a list in the IN variables.
dataEnteringNode = IN

def tolist(obj1):
	if hasattr(obj1,'__iter__'): return obj1
	else: return [obj1]

def uniqueIndexes(l):
    seen = set()
    res = []
    for i, n in enumerate(l):
        if n not in seen:
            res.append(i)
            seen.add(n)
    return res

sourceinstances = UnwrapElement(tolist(IN[0]))
cleaninstances = []
types = []
for sourceinstance in sourceinstances:
	famtypename = sourceinstance.Symbol.GetParameters("Type Name")[0].AsString()
	nametotest = famtypename.lower()
	if "rigged" in nametotest:
		continue
	else:
		cleaninstances.append(sourceinstance)
		types.append(famtypename)
unique = uniqueIndexes(types)

result = []
count = 0
for cleaninstance in cleaninstances:
	if count in unique:
		result.append(cleaninstance)
	count += 1

#Assign your output to the OUT variable.
OUT = result
# ----------------------------------------
smart_rft_path = Custom[Smart RFT Path](VARRFTFile=n06_family_template_rft_generic)  # package Synthesize toolkit; Smart RFT Path
k_unhost_family = Custom[K-Unhost Family](VARFamilyInstance=python_script@L1, VARFamilyTemplate=smart_rft_path, VAROverwriteParameters=n04_overwrite_parameters_if, VARSeparators=n05_name_separator, VARInitialHostWidth=n03_host_width_if_found_0_will, VARForceWorkPlaneBased=n02_force_workplane)  # package Synthesize toolkit; K-Unhost Family
