# Dynamo graph Family.K-Unhoster By Family - Single Selection.dyn (Dynamo 2.13.1.3887)
# author: karam@aecedx.com
# packages: Synthesize toolkit 12.5.1

debug_python_no_message = Custom[Debug Python No Message]()  # package Synthesize toolkit; Debug Python

# group: Input
n01_select_family = DSModelElementSelection()  # "01.Select Family"; nothing selected; graph input
n06_family_template_rft_generic = Filename("..\..\..\ProgramData\Autodesk\RVT 2020\Family Templates\English\Metric Generic Model.rft")  # "06.Family Template .RFT (Generic Model Recommended)"; graph input
n04_overwrite_parameters_if = BoolSelector(true)  # "04.Overwrite Parameters If Unhosted Family Already Loaded ?"; graph input
n05_name_separator = StringInput("_")  # "05.Name Separator"; graph input
n03_host_width_if_found_0_will = DoubleInput(0)  # "03.Host Width If Found (0 Will Use Default)"; graph input
n02_force_workplane = BoolSelector(false)  # "02.Force Workplane ?"; graph input

smart_rft_path = Custom[Smart RFT Path](VARRFTFile=n06_family_template_rft_generic)  # package Synthesize toolkit; Smart RFT Path
k_unhost_family = Custom[K-Unhost Family](VARFamilyInstance=n01_select_family, VARFamilyTemplate=smart_rft_path, VAROverwriteParameters=n04_overwrite_parameters_if, VARSeparators=n05_name_separator, VARInitialHostWidth=n03_host_width_if_found_0_will, VARForceWorkPlaneBased=n02_force_workplane)  # package Synthesize toolkit; K-Unhost Family
