# Dynamo graph Family.Mirrored Elements Detection.dyn (Dynamo 2.13.1.3887)
# author: karam@aecedx.com
# packages: Synthesize toolkit 12.5.1

# group: Input
delete_old_will_not_create_a = BoolSelector(false)  # "Delete Old ? (Will Not Create a Selection Filter if Activated)"
n01_filter_name_to_create_for = StringInput("Dynamo Mirrored Elements")  # "01.Filter Name to Create For Mirrored Elements"; graph input
n02_overwrite_existing_filter = BoolSelector(false)  # "02.Overwrite Existing Filter ? (False for Adding Elements)"; graph input
auto_place_family_with_correct = BoolSelector(false)  # "Auto Place Family With Correct Orientation ?"

element_types = ElementTypes("FamilyInstance")
all_elements_of_type = ElementsOfType(element_type=element_types)
al_get_host_element = Custom[AL.Get Host Element](VARhostedElement=all_elements_of_type)  # package Synthesize toolkit; This node will retrieve a host element from hosted element. Ex. feed in door, get wall.
isNull = Object.IsNull(object=al_get_host_element)
filterByBoolMask = List.FilterByBoolMask(list=all_elements_of_type, mask=isNull)
code_block = CodeBlock { true; }
mirrored_elements_detect = Custom[Mirrored Elements Detect](VARDeleteOldWillNotCreateaSelectionFilterifActivated=delete_old_will_not_create_a, VARFilterNametoCreate=n01_filter_name_to_create_for, VAROverwriteExistingFilter=n02_overwrite_existing_filter, VARAutoPlaceFamilyWithCorrectOrientation=auto_place_family_with_correct, VARElements=filterByBoolMask.in, VARCreateSelectionFilter=code_block)  # package Synthesize toolkit; Mirrored Elements Detect

# group: Report
n01_number_of_mirrored_elements = Watch(mirrored_elements_detect.VARNumberofMirroredElements)  # "01.Number of Mirrored Elements"; graph output

debug_python = Custom[Debug Python]()  # package Synthesize toolkit; Debug Python
