# Dynamo graph Family.Refine Level and Offset By All Elements of Category.dyn (Dynamo 2.13.1.3887)
# author: karam@aecedx.com
# packages: Synthesize toolkit 12.5.1

debug_python = Custom[Debug Python]()  # package Synthesize toolkit; Debug Python

# group: Input
n01_category_to_select = Categories("OST_Windows")  # "01.Category to Select"; graph input
n03_loadable_level_parameter = StringInput("Level")  # "03.Loadable : Level Parameter"; graph input
n04_loadable_offset_parameter = StringInput("Sill Height")  # "04.Loadable : Offset Parameter"; graph input
n02_system_refine_walls_top = BoolSelector(false)  # "02.System : Refine Walls Top Constraints"; graph input

all_elements_of_category = ElementsOfCategory(Category=n01_category_to_select)
flatten = List.Flatten(list=all_elements_of_category)
refine_families = Custom[Refine Families](VARElements=flatten, VARLoadablLevelParameter=n03_loadable_level_parameter, VARLoadablOffsetParameter=n04_loadable_offset_parameter, SystemRefineWallTopConstraints=n02_system_refine_walls_top)  # package Synthesize toolkit; Refine Families
