# Dynamo graph Family.Rotate By Selection Filter.dyn (Dynamo 2.13.1.3887)
# author: karam@aecedx.com
# packages: Synthesize toolkit 12.5.1

hot_get_all_filter = Custom[HOT.Get All Filter]()  # package Synthesize toolkit; Get all Filter
toLower = String.ToLower(string=hot_get_all_filter.VARName)
trimWhitespace = String.TrimWhitespace(string=toLower)

# group: Input
n01_selection_filter_to_read = StringInput("Elements to Rotate")  # "01.Selection Filter to Read"; graph input
n04_randomize_rotaions = BoolSelector(false)  # "04.Randomize Rotaions ?"; graph input
n02_additive_adds_rotation_to = BoolSelector(false)  # "02.Additive (Adds Rotation to Existed Value) ?"; graph input
n05_minimum_random_rotation_angle = DoubleSlider(0, range=-360..360 step 1)  # "05.Minimum Random Rotation Angle (Useful When Randomize Rotations is Activated)"; graph input
n06_maximum_random_rotation_angle = DoubleSlider(360, range=-360..360 step 1)  # "06.Maximum Random Rotation Angle (Useful When Randomize Rotations is Activated)"; graph input
degree = DoubleInput(0)  # "03.Degree"; graph input

toLower_2 = String.ToLower(string=n01_selection_filter_to_read)
trimWhitespace_2 = String.TrimWhitespace(string=toLower_2)
eq = trimWhitespace == trimWhitespace_2
filterByBoolMask = List.FilterByBoolMask(list=hot_get_all_filter.VARElement, mask=eq)
elements = Custom[CW.SelectionSet.Elements](VARselectionSet=filterByBoolMask.in)  # package Synthesize toolkit; Retrieves all elements stored in a selection set
flatten = List.Flatten(list=elements)
family_smart_rotation = Custom[Family Smart Rotation](VARFamilyInstance=flatten, VARRandomizeRotaions=n04_randomize_rotaions, VARAdditiveAddsRotationtoExistedValue=n02_additive_adds_rotation_to, VARMinimumRnadomRotationAngleUsefulWhenRandomizeRotationsisActivated=n05_minimum_random_rotation_angle, VARMaximumRandomRotationAngleUsefulWhenRandomizeRotationsisActivated=n06_maximum_random_rotation_angle, VARDegree=degree)  # package Synthesize toolkit; Family Smart Rotation
debug_python = Custom[Debug Python]()  # package Synthesize toolkit; Debug Python
