# Dynamo graph Family.SAT Sync.dyn (Dynamo 2.13.1.3887)
# author: karam@aecedx.com
# packages: Synthesize toolkit 12.5.1

debug_python_no_message = Custom[Debug Python No Message]()  # package Synthesize toolkit; Debug Python

# group: Input
n22_alternative_sync_method_force = BoolSelector(false)  # "22.Alternative Sync Method : Force Join Surfaces ?"; graph input
n21_alternative_sync_method_force = BoolSelector(false)  # "21.Alternative Sync Method : Force Join Solids ?"; graph input
n23_alternative_sync_method = BoolSelector(false)  # "23.Alternative Sync Method : Switch (Y To Z) Up Orientation ?"; graph input
n24_alternative_sync_method_old_x = DoubleInput(1)  # "24.Alternative Sync Method : Old X"; graph input
n25_alternative_sync_method_new_x = DoubleInput(1)  # "25.Alternative Sync Method : New X"; graph input
n26_alternative_sync_method_old_y = DoubleInput(1)  # "26.Alternative Sync Method : Old Y"; graph input
n27_alternative_sync_method_new_y = DoubleInput(1)  # "27.Alternative Sync Method : New Y"; graph input
n28_alternative_sync_method_old_z = DoubleInput(1)  # "28.Alternative Sync Method : Old Z"; graph input
n29_alternative_sync_method_new_z = DoubleInput(1)  # "29.Alternative Sync Method : New Z"; graph input
n20_alternative_sync_method = BoolSelector(false)  # "20.Alternative Sync Method : Explode (Useful for Dirty Projects)"; graph input
n01_exported_sat_file = Filename("No file selected.")  # "01.Exported SAT File"; graph input
n18_material_overwrite_existed = BoolSelector(false)  # "18.Material: Overwrite Existed Parameters ?"; graph input
n06_one_family_only = BoolSelector(true)  # "06.One Family Only ?"; graph input
n04_auto_family_number = BoolSelector(false)  # "04.Auto Family Number ?"; graph input
n03_family_name = StringInput("SAT Sync Family")  # "03.Family Name"; graph input
n05_family_number = DoubleInput(1)  # "05.Family Number"; graph input
n07_family_category = Categories("OST_Mass")  # "07.Family Category"; graph input
n10_family_template = Filename("..\..\..\..\..\..\..\..\..\..\ProgramData\Autodesk\RVT 2020\Family Templates\English\Conceptual Mass\Metric Mass.rft")  # "10.Family Template"; graph input
n13_is_shared_family = BoolSelector(false)  # "13.Is Shared Family ?"; graph input
n14_is_workplane_based = BoolSelector(false)  # "14.Is Workplane Based ?"; graph input
n12_to_void = BoolSelector(false)  # "12.To Void ?"; graph input
n15_material_name_to_assign = StringInput("")  # "15.Material Name To Assign"; graph input
n17_material_single_parameter = BoolSelector(true)  # "17.Material: Single Parameter Only ?"; graph input
n16_material_is_instance = BoolSelector(true)  # "16.Material: Is Instance Parameter ?"; graph input
subcategory = StringInput("")  # "08.Subcategory"; graph input
n09_subcategory_material = StringInput("")  # "09.Subcategory Material"; graph input
n11_self_origin = BoolSelector(false)  # "11.Self Origin ?"; graph input
n19_auto_alternative_sync_method = BoolSelector(true)  # "19.Auto Alternative Sync Method ? (Process Geometry Through Dynamo)"; graph input
n02_method_false_import_symbol = BoolSelector(true)  # "02.Method: False = Import Symbol | True = Family"; graph input

python_script = Python(IN[0]=n22_alternative_sync_method_force, IN[1]=n21_alternative_sync_method_force, IN[2]=n23_alternative_sync_method, IN[3]=n24_alternative_sync_method_old_x, IN[4]=n25_alternative_sync_method_new_x, IN[5]=n26_alternative_sync_method_old_y, IN[6]=n27_alternative_sync_method_new_y, IN[7]=n28_alternative_sync_method_old_z, IN[8]=n29_alternative_sync_method_new_z, IN[9]=n20_alternative_sync_method)  # IronPython2
# ---------- python_script.python (21 lines) ----------
import clr
clr.AddReference('ProtoGeometry')
from Autodesk.DesignScript.Geometry import *
#The inputs to this node will be stored as a list in the IN variables.
dataEnteringNode = IN

bool1 = IN[0]
bool2 = IN[1]
bool3 = IN[2]
oldx = IN[3]
newx = IN[4]
oldy = IN[5]
newy = IN[6]
oldz = IN[7]
newz = IN[8]
explode = IN[9]

if bool1 == True or bool2 == True or bool3 == True or oldx != newx or oldy != newy or oldz != newz or explode == True:
	OUT = True
else:
	OUT = False
# ----------------------------------------
empty = List.Empty()
scopeIf = Custom[CW.ScopeIf+](VARtest=python_script, VARtrue=n01_exported_sat_file, VARfalse=empty)  # package Synthesize toolkit; A (hopefully) more robust implementation of ScopeIf. Tests a single boolean and returns a value accordingly.
better_geometry_importfromsat = Custom[Better Geometry.ImportFromSAT](VARSATFile=scopeIf)  # package Synthesize toolkit; Better Geometry.ImportFromSAT
div = n25_alternative_sync_method_new_x / n24_alternative_sync_method_old_x
div_2 = n27_alternative_sync_method_new_y / n26_alternative_sync_method_old_y
div_3 = n29_alternative_sync_method_new_z / n28_alternative_sync_method_old_z
smart_geometry_scale = Custom[Smart Geometry Scale](VARGeometry=better_geometry_importfromsat, VARXAmount=div, VARYAmount=div_2, VARZAmount=div_3)  # package Synthesize toolkit; Smart Geometry Scale
python_script_2 = Python(IN[0]=smart_geometry_scale, IN[1]=n23_alternative_sync_method)  # IronPython2
# ---------- python_script_2.python (37 lines) ----------
import clr
clr.AddReference('ProtoGeometry')
from Autodesk.DesignScript.Geometry import *

def tolist(obj1):
	if hasattr(obj1,'__iter__'): return obj1
	else: return [obj1]

def flatten(x):
    result = []
    for el in x:
        if hasattr(el, "__iter__") and not isinstance(el, basestring):
            result.extend(flatten(el))
        else:
            result.append(el)
    return result

geom = flatten(tolist(IN[0]))
bool = IN[1]

if bool:
	try:
		bbox = BoundingBox.ByGeometry(geom)
		plane = Plane.ByOriginNormal(Curve.PointAtParameter(Line.ByStartPointEndPoint(bbox.MinPoint,Point.ByCoordinates(bbox.MaxPoint.X,bbox.MaxPoint.Y,bbox.MinPoint.Z)),0.5),Vector.XAxis())
		rotated = []
		for g in geom:
			try:
				rotated.append(Geometry.Rotate(g,plane,90))
			except:
				pass
	except:
		rotated = geom
else:
	rotated = geom
	
#Assign your output to the OUT variable.
OUT = rotated
# ----------------------------------------
smart_explode = Custom[Smart Explode](VARGeometry=python_script_2, VARExplodeOrNot=n20_alternative_sync_method)  # package Synthesize toolkit; Smart Explode
scopeIf_2 = Custom[CW.ScopeIf+](VARtest=python_script, VARtrue=smart_explode, VARfalse=n01_exported_sat_file)
code_block = CodeBlock { true; }
ne = n02_method_false_import_symbol != code_block
k_family_insert = Custom[K-Family Insert](VARGeometryorSAT=scopeIf_2, VAROverwriteParams=n18_material_overwrite_existed, VAROneFamily=n06_one_family_only, VARAvoidConfilct=n04_auto_family_number, VARDynamoProcessSAT=python_script, VARJoinAdjacentSurfacesForcesDynamoProcessSAT=n22_alternative_sync_method_force, VARJoinAdjacentSolidsForcesDynamoProcessSAT=n21_alternative_sync_method_force, VARFamilyName=n03_family_name, VARFamilyNumber=n05_family_number, VARFamilyCategory=n07_family_category, VARFamilyTemplatePath=n10_family_template, VARIsShared=n13_is_shared_family, VARIsWorkplane=n14_is_workplane_based, VARToVoid=n12_to_void, VARMaterialName=n15_material_name_to_assign, VARIsOneMaterial=n17_material_single_parameter, VARIsMaterialInstance=n16_material_is_instance, VARSubcategory=subcategory, VARSubcategoryMaterial=n09_subcategory_material, VARSelfOrigin=n11_self_origin, VARAutoAlternative=n19_auto_alternative_sync_method, VARShowMessages=code_block, VARImportInstanceInstead=ne)  # package Synthesize toolkit; K-Family Insert
