# Dynamo graph Family.Scatter Randomly (Non-Workplane Families) By Model Lines.dyn (Dynamo 2.13.1.3887)
# author: karam@aecedx.com
# packages: Synthesize toolkit 12.5.1

# group: Input
n08_create_selection_filter = BoolSelector(true)  # "08.Create Selection Filter ?"; graph input
n09_filter_name_to_create = StringInput("Dynamo Scattered Elements Randomly")  # "09.Filter Name to Create"; graph input
n10_overwrite_existing_filter = BoolSelector(false)  # "10.Overwrite Existing Filter ? (False for Adding Elements)"; graph input
n01_select_scatter_boundaries = DSModelElementsSelection()  # "01.Select Scatter Boundaries (Model Lines)"; nothing selected; graph input
offset = DoubleInput(0)  # "02.Offset"; graph input
n03_maximum_number_of_elements = DoubleInput(100)  # "03.Maximum Number of Elements"; graph input
n04_spacing_between_elements = DoubleInput(5)  # "04.Spacing Between Elements"; graph input
n06_all_types_false_for_specific = BoolSelector(true)  # "06.All Types ? (False for Specific Types)"; graph input
n05_family_names_separate_by = StringInput("AECedx_Tree*")  # "05.Family Names (Separate By Comma , - or * To Select All Matching)"; graph input
n07_specific_type_names_separate = StringInput("Type 1")  # "07.Specific Type Names (Separate By Comma , )"; graph input

curves = Element.Curves(element=n01_select_scatter_boundaries)
flatten = List.Flatten(list=curves)
code_block = CodeBlock { "Surface"; "Solid"; }
byClassName = Custom[SP.Filter.ByClassName](VARobject=flatten, VARclassName=code_block.out0)  # package Synthesize toolkit; Filters a list of objects by the object's class name. Note that Dynamo elements belong to different classes than their Revit counterparts. Use the Object.Class node to check an object's class.
byClassName_2 = Custom[SP.Filter.ByClassName](VARobject=byClassName.VARout, VARclassName=code_block.out1)
as_polycurve_bycurves = Custom[AS.[&] PolyCurve.ByCurves](VARcurves=byClassName_2.VARout)  # package Synthesize toolkit; Create polycurves from an unordered list of curves.
closeWithLine = PolyCurve.CloseWithLine(polyCurve=as_polycurve_bycurves.VARpolyCurve)
byPatch = Surface.ByPatch(closedCurve=closeWithLine)
code_block_2 = CodeBlock { ","; false; }
family_and_type_selector = Custom[Family and Type Selector](VARAllElementsofFamilyNameAlltypes=n06_all_types_false_for_specific, VARFamilyName=n05_family_names_separate_by, VARSpecificTypeNamesSeparatebySymbol=n07_specific_type_names_separate, VARSeparationSymbol=code_block_2.out0, VAROnlyInActiveView=code_block_2.out1)  # package Synthesize toolkit; Family and Type Selector
flatten_2 = List.Flatten(list=family_and_type_selector.VARFamilyTypesList)
python_script = Python(IN[0]=flatten_2)  # IronPython2
# ---------- python_script.python (82 lines) ----------
# Created By Karam Baki : karam@aecedx.com
# Enable Python support and load DesignScript library
# IMPORTANT : ALL DYNAMO DESIGN SCRIPT NODES ARE AS (dg)
import clr
clr.AddReference('ProtoGeometry')
from Autodesk.DesignScript import Geometry as dg

# EXTENSION Enable ToDSType
clr.AddReference('RevitNodes')
import Revit
clr.ImportExtensions(Revit.Elements)

# Enable Revit Elements
from Revit.Elements import *

# EXTENSION Enable Geometry Conversion Methods
clr.ImportExtensions(Revit.GeometryConversion)

# Enable Revit API
clr.AddReference('RevitAPI')
from Autodesk.Revit.DB import *
from Autodesk.Revit.DB.Architecture import *
# Enable DocumentManager and TransactionManager
clr.AddReference('RevitServices')
from RevitServices.Persistence import DocumentManager
from RevitServices.Transactions import TransactionManager

# Enable ICollection List Translate
clr.AddReference("System")
import System.Collections.Generic
from System.Collections.Generic import List

from Autodesk.Revit.DB.Structure import StructuralType

clr.AddReference("RevitAPIUI")
from Autodesk.Revit.UI import TaskDialog

title = "AECedx - Karam"

# Choose The Current Document
doc = DocumentManager.Instance.CurrentDBDocument
uidoc = DocumentManager.Instance.CurrentUIApplication.ActiveUIDocument
uiapp = DocumentManager.Instance.CurrentUIApplication
app = uiapp.Application

famtypes = UnwrapElement(IN[0])

def isworkplane(famtype):
	if not famtype.IsActive: famtype.Activate()
	try:
		test = doc.Create.NewFamilyInstance(XYZ(0,0,0), famtype, StructuralType.NonStructural)
		eachparams = test.GetOrderedParameters()
		workplanebased = False
		for epms in eachparams:
			pname = epms.Definition.Name
			if pname == "Work Plane":
					workplanebased = True
		doc.Delete(test.Id)
	except:
		workplanebased = False
	
	return workplanebased

TransactionManager.Instance.EnsureInTransaction(doc)
workplaneslist = []
for famtype in famtypes:
	if isworkplane(famtype) == True:
		workplaneslist.append(famtype.FamilyName + " (Is Workplane Based)")
TransactionManager.Instance.TransactionTaskDone()

temp_list = []
for i in workplaneslist:
    if i not in temp_list:
        temp_list.append(i)
workplaneslist = temp_list

if len(workplaneslist) > 0:
	workplaneslist.Insert(0,"Convert The Following to Non-Workplane:")
	msg = "\n".join(workplaneslist)
	OUT = TaskDialog.Show(title, msg)
else:
	OUT = famtypes
# ----------------------------------------
scatter_elements = Custom[Scatter Elements](VARSurfaces=byPatch, VAROffset=offset, VARMaximumNumberofElements=n03_maximum_number_of_elements, VARSpacingBetweenElements=n04_spacing_between_elements, VARFamilyTypeList=python_script)  # package Synthesize toolkit; Scatter Elements
generate_selection_filter = Custom[Generate Selection Filter](VARCreateSelectionFilter=n08_create_selection_filter, VARFilterNametoCreate=n09_filter_name_to_create, VAROverwriteExistingFilter=n10_overwrite_existing_filter, VARElements=scatter_elements)  # package Synthesize toolkit; Generate Selection FIlter
debug_python = Custom[Debug Python]()  # package Synthesize toolkit; Debug Python
