# Dynamo graph Family.Types Randomize By Isolated Elements.dyn (Dynamo 2.13.1.3887)
# author: karam@aecedx.com
# packages: Synthesize toolkit 12.5.1

# group: Input
n02_all_types_false_for_specific = BoolSelector(true)  # "02.All Types ? (False for Specific Types)"; graph input
n01_family_names_separate_by = StringInput("System Panel")  # "01.Family Names (Separate By Comma , - or * To Select All Matching)"; graph input
n03_specific_type_names_separate = StringInput("Glazed, Solid")  # "03.Specific Type Names (Separate By Comma , )"; graph input
n04_proceed = BoolSelector(false)  # "04.Proceed ?"; graph input

code_block = CodeBlock { ","; true; }
family_and_type_selector = Custom[Family and Type Selector](VARAllElementsofFamilyNameAlltypes=n02_all_types_false_for_specific, VARFamilyName=n01_family_names_separate_by, VARSpecificTypeNamesSeparatebySymbol=n03_specific_type_names_separate, VARSeparationSymbol=code_block.out0, VAROnlyInActiveView=code_block.out1)  # package Synthesize toolkit; Family and Type Selector
count = List.Count(list=family_and_type_selector.VARElements)

# group: Result
n01_number_of_elements = Watch(count)  # "01.Number of Elements"; graph output
n02_elements_to_select = Watch(family_and_type_selector.VARElements)  # "02.Elements to select"; graph output

debug_python = Custom[Debug Python]()  # package Synthesize toolkit; Debug Python
python_script = Python(IN[0]=family_and_type_selector.VARElements, IN[1]=family_and_type_selector.VARFamilyTypesList, IN[2]=n04_proceed)  # IronPython2
# ---------- python_script.python (52 lines) ----------
import clr
clr.AddReference('RevitNodes')
import Revit
clr.ImportExtensions(Revit.Elements)
clr.AddReference('RevitAPI')
from Autodesk.Revit.DB import *
clr.AddReference('RevitServices')
from RevitServices.Persistence import DocumentManager
from RevitServices.Transactions import TransactionManager
import System
pf_path = System.Environment.GetFolderPath(System.Environment.SpecialFolder.ProgramFilesX86)
import sys
sys.path.append('%s\IronPython 2.7\Lib' %pf_path)
import random

def tolist(obj1):
	if hasattr(obj1,'__iter__'): return obj1
	else: return [obj1]

def flatten(x):
    result = []
    for el in x:
        if hasattr(el, "__iter__") and not isinstance(el, basestring):
            result.extend(flatten(el))
        else:
            result.append(el)
    return result

elements=UnwrapElement(flatten(tolist(IN[0])))
famtypes=UnwrapElement(flatten(tolist(IN[1])))
proceed=IN[2]

if proceed:
	cleanfamtypes = []
	for famtype in famtypes:
		if famtype.GetParameters("Type Name")[0].AsString() == "Wall" and famtype.FamilyName == "System Panel":
			continue
		else:
			cleanfamtypes.append(famtype)	
	doc = DocumentManager.Instance.CurrentDBDocument
	TransactionManager.Instance.EnsureInTransaction(doc)
	result = []
	for element in elements:
		try:
			element.Symbol = random.choice(cleanfamtypes)
			result.append(element)
		except:
			pass
	TransactionManager.Instance.TransactionTaskDone()
	OUT = result
else:
	OUT = "Nothing to Do"
# ----------------------------------------
