# Dynamo graph Filter.Selection K-Filter Select Elements.dyn (Dynamo 2.13.1.3887)
# author: karam@aecedx.com
# packages: Synthesize toolkit 12.5.1

hot_get_all_filter = Custom[HOT.Get All Filter]()  # package Synthesize toolkit; Get all Filter
n01_selection_filter_to_read = StringInput("Fitler Name")  # "01.Selection Filter to Read"; graph input
eq = hot_get_all_filter.VARName == n01_selection_filter_to_read
filterByBoolMask = List.FilterByBoolMask(list=hot_get_all_filter.VARElement, mask=eq)
elements = Custom[CW.SelectionSet.Elements](VARselectionSet=filterByBoolMask.in)  # package Synthesize toolkit; Retrieves all elements stored in a selection set
flatten = List.Flatten(list=elements)
hot_select_in_revit = Custom[HOT.Select in Revit](VARElement=flatten)  # package Synthesize toolkit; Select Elements in Revit
n01_all_selection_filters = Watch(hot_get_all_filter.VARName)  # "01.All Selection Filters"; graph output
debug_python_no_message = Custom[Debug Python No Message]()  # package Synthesize toolkit; Debug Python
