# Dynamo graph Filter.VG Filters Change Visibility.dyn (Dynamo 2.13.1.3887)
# author: karam@aecedx.com
# packages: Synthesize toolkit 12.5.1

# group: Input
n07_override_plan_views = BoolSelector(true)  # "07.Override Plan Views"; graph input
n08_1_exact_name_2_contains_name = IntegerSlider(3, range=1..3 step 1)  # "08.1 = Exact Name | 2 = Contains Name | 3 = All"; graph input
n09_plan_view_name = StringInput("Level 1")  # "09.Plan View Name"; graph input
n16_override_ceiling_views = BoolSelector(false)  # "16.Override Ceiling Views"; graph input
n17_1_exact_name_2_contains_name = IntegerSlider(3, range=1..3 step 1)  # "17.1 = Exact Name | 2 = Contains Name | 3 = All"; graph input
n18_ceiling_view_name = StringInput("Level 1")  # "18.Ceiling View Name"; graph input
n25_override_structural_views = BoolSelector(false)  # "25.Override Structural Views"; graph input
n26_1_exact_name_2_contains_name = IntegerSlider(3, range=1..3 step 1)  # "26.1 = Exact Name | 2 = Contains Name | 3 = All"; graph input
n27_structural_view_name = StringInput("Level 1")  # "27.Structural View Name"; graph input
n19_override_area_views = BoolSelector(false)  # "19.Override Area Views"; graph input
n20_1_exact_name_2_contains_name = IntegerSlider(3, range=1..3 step 1)  # "20.1 = Exact Name | 2 = Contains Name | 3 = All"; graph input
n21_area_view_name = StringInput("Level 1")  # "21.Area View Name"; graph input
n10_override_elevation_views = BoolSelector(true)  # "10.Override Elevation Views"; graph input
n11_1_exact_name_2_contains_name = IntegerSlider(3, range=1..3 step 1)  # "11.1 = Exact Name | 2 = Contains Name | 3 = All"; graph input
n12_elevation_view_name = StringInput("North")  # "12.Elevation View Name"; graph input
n13_override_section_views = BoolSelector(true)  # "13.Override Section Views"; graph input
n14_1_exact_name_2_contains_name = IntegerSlider(3, range=1..3 step 1)  # "14.1 = Exact Name | 2 = Contains Name | 3 = All"; graph input
n15_section_view_name = StringInput("Section 1")  # "15.Section View Name"; graph input
n04_override_3d_views = BoolSelector(true)  # "04.Override 3D Views"; graph input
n05_1_exact_name_2_contains_name = IntegerSlider(3, range=1..3 step 1)  # "05.1 = Exact Name | 2 = Contains Name | 3 = All"; graph input
n06_3d_view_name = StringInput("{3D}")  # "06.3D View Name"; graph input
n22_override_detail_views = BoolSelector(false)  # "22.Override Detail Views"; graph input
n23_1_exact_name_2_contains_name = IntegerSlider(3, range=1..3 step 1)  # "23.1 = Exact Name | 2 = Contains Name | 3 = All"; graph input
n24_detail_view_name = StringInput("Detail 0")  # "24.Detail View Name"; graph input
n03_filter_visibility_false_turn = BoolSelector(true)  # "03.Filter Visibility : False = Turn Off | True = Turn On"; graph input
n02_change_visibilty_for_all = BoolSelector(false)  # "02.Change Visibilty For All Filters Instead ?"; graph input
n01_filter_to_look_for = StringInput("Filter Name")  # "01.Filter to Look For"; graph input

python_script = Python(IN[0]=n07_override_plan_views, IN[1]=n08_1_exact_name_2_contains_name, IN[2]=n09_plan_view_name, IN[3]=n16_override_ceiling_views, IN[4]=n17_1_exact_name_2_contains_name, IN[5]=n18_ceiling_view_name, IN[6]=n25_override_structural_views, IN[7]=n26_1_exact_name_2_contains_name, IN[8]=n27_structural_view_name, IN[9]=n19_override_area_views, IN[10]=n20_1_exact_name_2_contains_name, IN[11]=n21_area_view_name, IN[12]=n10_override_elevation_views, IN[13]=n11_1_exact_name_2_contains_name, IN[14]=n12_elevation_view_name, IN[15]=n13_override_section_views, IN[16]=n14_1_exact_name_2_contains_name, IN[17]=n15_section_view_name, IN[18]=n04_override_3d_views, IN[19]=n05_1_exact_name_2_contains_name, IN[20]=n06_3d_view_name, IN[21]=n22_override_detail_views, IN[22]=n23_1_exact_name_2_contains_name, IN[23]=n24_detail_view_name)  # IronPython2
# ---------- python_script.python (231 lines) ----------
# Filtering Codes By Karam Baki, karam@aecedx.com
# Copyright(c) 2014, Konrad Sobon
# @arch_laboratory, http://archi-lab.net

import clr
clr.AddReference('ProtoGeometry')
from Autodesk.DesignScript.Geometry import *
 
# Import DocumentManager and TransactionManager
clr.AddReference("RevitServices")
import RevitServices
from RevitServices.Persistence import DocumentManager
from RevitServices.Transactions import TransactionManager
 
# Import RevitAPI
clr.AddReference("RevitAPI")
import Autodesk
from Autodesk.Revit.DB import *
 
doc = DocumentManager.Instance.CurrentDBDocument
uiapp = DocumentManager.Instance.CurrentUIApplication
app = uiapp.Application
 
from System.Collections.Generic import *
 
# Import ToDSType(bool) extension method
clr.AddReference("RevitNodes")
import Revit
clr.ImportExtensions(Revit.Elements)

#collect all views in the model
collector = FilteredElementCollector(doc)
views = collector.OfClass(View).ToElements()
 
#sort views into separate lists based on view type
areaPlans, ceilingPlans, columnSchedules = [], [], []
costReport, details, draftingViews = [], [], []
drawingSheets, elevations, engineetingPlans = [], [], []
floorPlans, internal, legends, loadReports = [], [], [], []
panelSchedules, pressureLossReports, renderings = [], [], []
reports, schedules, sections, threeD = [], [], [], []
undefined, walkthrough = [], []
for i in views:
	if not i.IsTemplate:
		if i.ViewType == ViewType.AreaPlan:
			areaPlans.append(i.ToDSType(True))
		elif i.ViewType == ViewType.CeilingPlan:
			ceilingPlans.append(i.ToDSType(True))
		elif i.ViewType == ViewType.ColumnSchedule:
			columnSchedules.append(i.ToDSType(True))
		elif i.ViewType == ViewType.CostReport:
			costReport.append(i.ToDSType(True))
		elif i.ViewType == ViewType.Detail:
			details.append(i.ToDSType(True))
		elif i.ViewType == ViewType.DraftingView:
			draftingViews.append(i.ToDSType(True))
		elif i.ViewType == ViewType.DrawingSheet:
			drawingSheets.append(i.ToDSType(True))
		elif i.ViewType == ViewType.Elevation:
			elevations.append(i.ToDSType(True))
		elif i.ViewType == ViewType.EngineeringPlan:
			engineetingPlans.append(i.ToDSType(True))
		elif i.ViewType == ViewType.FloorPlan:
			floorPlans.append(i.ToDSType(True))
		elif i.ViewType == ViewType.Internal:
			internal.append(i.ToDSType(True))
		elif i.ViewType == ViewType.Legend:
			legends.append(i.ToDSType(True))
		elif i.ViewType == ViewType.LoadsReport:
			loadReports.append(i.ToDSType(True))
		elif i.ViewType == ViewType.PanelSchedule:
			panelSchedules.append(i.ToDSType(True))
		elif i.ViewType == ViewType.PresureLossReport:
			pressureLossReports.append(i.ToDSType(True))
		elif i.ViewType == ViewType.Rendering:
			renderings.append(i.ToDSType(True))
		elif i.ViewType == ViewType.Report:
			reports.append(i.ToDSType(True))
		elif i.ViewType == ViewType.Schedule:
			schedules.append(i.ToDSType(True))
		elif i.ViewType == ViewType.Section:
			sections.append(i.ToDSType(True))
		elif i.ViewType == ViewType.ThreeD:
			threeD.append(i.ToDSType(True))
		elif i.ViewType == ViewType.Undefined:
			undefined.append(i.ToDSType(True))
		elif i.ViewType == ViewType.Walkthrough:
			walkthrough.append(i.ToDSType(True))
		else:
			continue

overrideplans = IN[0]
planscond = IN[1]
planname = IN[2].lower()

newfloorPlans = []
if overrideplans == True:
	for e in floorPlans:
		if planscond == 1:
			if e.Name.lower() == planname:
				newfloorPlans.append(e)
		elif planscond == 2:
			if planname in e.Name.lower():
				newfloorPlans.append(e)
		elif planscond == 3:
			newfloorPlans.append(e)

overrideceilings = IN[3]
ceilingscond = IN[4]
ceilingname = IN[5].lower()

newceilingPlans = []
if overrideceilings == True:
	for e in ceilingPlans:
		if ceilingscond == 1:
			if e.Name.lower() == ceilingname:
				newceilingPlans.append(e)
		elif ceilingscond == 2:
			if ceilingname in e.Name.lower():
				newceilingPlans.append(e)
		elif ceilingscond == 3:
			newceilingPlans.append(e)

overrideengineeting = IN[6]
engineetingscond = IN[7]
engineetingname = IN[8].lower()	

newengineetingPlans = []
if overrideengineeting == True:
	for e in engineetingPlans:
		if engineetingscond == 1:
			if e.Name.lower() == engineetingname:
				newengineetingPlans.append(e)
		elif engineetingscond == 2:
			if engineetingname in e.Name.lower():
				newengineetingPlans.append(e)
		elif engineetingscond == 3:
			newengineetingPlans.append(e)		
			
overridearea = IN[9]
areascond = IN[10]
areaname = IN[11].lower()	

newareaPlans = []
if overridearea == True:
	for e in areaPlans:
		if areascond == 1:
			if e.Name.lower() == areaname:
				newareaPlans.append(e)
		elif areascond == 2:
			if areaname in e.Name.lower():
				newareaPlans.append(e)
		elif areascond == 3:
			newareaPlans.append(e)

overrideelvs = IN[12]
elvsscond = IN[13]
elvsname = IN[14].lower()	

newelvs = []
if overrideelvs == True:
	for e in elevations:
		if elvsscond == 1:
			if e.Name.lower() == elvsname:
				newelvs.append(e)
		elif elvsscond == 2:
			if elvsname in e.Name.lower():
				newelvs.append(e)
		elif elvsscond == 3:
			newelvs.append(e)

overridesec = IN[15]
secscond = IN[16]
secsname = IN[17].lower()	

newsections = []
if overridesec == True:
	for e in sections:
		if secscond == 1:
			if e.Name.lower() == secsname:
				newsections.append(e)
		elif secscond == 2:
			if secsname in e.Name.lower():
				newsections.append(e)
		elif secscond == 3:
			newsections.append(e)
			
overridethreede = IN[18]
threedescond = IN[19]
threedename = IN[20].lower()	

newthreedes = []
if overridethreede == True:
	for e in threeD:
		if threedescond == 1:
			if e.Name.lower() == threedename:
				newthreedes.append(e)
		elif threedescond == 2:
			if threedename in e.Name.lower():
				newthreedes.append(e)
		elif threedescond == 3:
			newthreedes.append(e)
			
overridedet = IN[21]
detscond = IN[22]
detname = IN[23].lower()	

newdets = []
if overridedet == True:
	for e in details:
		if detscond == 1:
			if e.Name.lower() == detname:
				newdets.append(e)
		elif detscond == 2:
			if detname in e.Name.lower():
				newdets.append(e)
		elif detscond == 3:
			newdets.append(e)
			
'''
#Assign your output to the OUT variable
OUT = areaPlans, ceilingPlans, columnSchedules, costReport, \
	details, draftingViews, drawingSheets, elevations, \
	engineetingPlans, floorPlans, internal, legends, \
	loadReports, panelSchedules, pressureLossReports, \
	renderings, reports, schedules, sections, threeD, \
	undefined, walkthrough
'''

result = newfloorPlans + newceilingPlans + newengineetingPlans + newareaPlans + newelvs + newsections + newthreedes + newdets
OUT = result 
# ----------------------------------------
flatten = List.Flatten(list=python_script)
code_block = CodeBlock { 1; }
chop = List.Chop(list=flatten, lengths=code_block)
hot_get_active_view_filter = Custom[HOT.Get Active View Filter]()  # package Synthesize toolkit; Get all Filter
flatten_2 = List.Flatten(list=hot_get_active_view_filter.VARId)
eq = hot_get_active_view_filter.VARName == n01_filter_to_look_for
filterByBoolMask = List.FilterByBoolMask(list=flatten_2, mask=eq)
scopeIf = Custom[CW.ScopeIf+](VARtest=n02_change_visibilty_for_all, VARtrue=hot_get_active_view_filter.VARId, VARfalse=filterByBoolMask.in)  # package Synthesize toolkit; A (hopefully) more robust implementation of ScopeIf. Tests a single boolean and returns a value accordingly.
flatten_3 = List.Flatten(list=scopeIf)
hot_view_set_filter_visibility = Custom[HOT.View Set Filter Visibility](VARView=chop@L1, VARVisibility=n03_filter_visibility_false_turn, VARFilterId=flatten_3)  # package Synthesize toolkit; Set View Filter Visibility
debug_python_no_message = Custom[Debug Python No Message]()  # package Synthesize toolkit; Debug Python
