# Dynamo graph Floors.Create By Faces Selection With Sub Element.dyn (Dynamo 2.13.1.3887)
# author: karam@aecedx.com
# packages: Synthesize toolkit 12.6.7

# group: Input
n05_create_selection_filter = BoolSelector(true)  # "05.Create Selection Filter ?"; graph input
n06_filter_name_to_create = StringInput("Dynamo Floors By Surfaces With Sub Element")  # "06.Filter Name to Create"; graph input
n07_overwrite_existing_filter = BoolSelector(false)  # "07.Overwrite Existing Filter ? (False for Adding Elements)"; graph input
n02_join_surfaces = BoolSelector(false)  # "02.Join Surfaces ?"; graph input
n01_select_surfaces = SelectFaces()  # "01.Select Surfaces"; nothing selected; graph input
n04_reference_level = Levels("Level 1")  # "04.Reference Level"; graph input
n03_floor_types = FloorTypes("Generic Floor - 400mm")  # "03.Floor Types"; graph input

flatten = List.Flatten(list=n01_select_surfaces)
code_block = CodeBlock { false; }
join_adjacent_surfaces = Custom[Join Adjacent Surfaces](VARSurfaces=flatten, VARNormalsCheck=code_block)  # package Synthesize toolkit; Join Adjacent Surfaces
scopeIf = Custom[CW.ScopeIf+](VARtest=n02_join_surfaces, VARtrue=join_adjacent_surfaces, VARfalse=n01_select_surfaces)  # package Synthesize toolkit; A (hopefully) more robust implementation of ScopeIf. Tests a single boolean and returns a value accordingly.
flatten_2 = List.Flatten(list=scopeIf)
perimeterCurves = Surface.PerimeterCurves(surface=flatten_2)
as_polycurve_bycurves = Custom[AS.[&] PolyCurve.ByCurves](VARcurves=perimeterCurves)  # package Synthesize toolkit; Create polycurves from an unordered list of curves.
flatten_3 = List.Flatten(list=as_polycurve_bycurves.VARpolyCurve)
plane = Custom[CW.Level.Plane](VARlevel=n04_reference_level)  # package Synthesize toolkit; Retrieves the plane of a given level
pullOntoPlane = Curve.PullOntoPlane(curve=flatten_3, plane=plane)
explode = Geometry.Explode(geometry=pullOntoPlane)
code_block_2 = CodeBlock { 0; }
curves_offset_to_revit = Custom[Curves Offset To Revit Compatibility](VARCurves=explode, VAROffset=code_block_2)  # package Synthesize toolkit; Curves Offset To Revit Compatibility
byOutlineTypeAndLevel = Floor.ByOutlineTypeAndLevel(outlineCurves=curves_offset_to_revit.VARCurves, floorType=n03_floor_types, level=n04_reference_level)
generate_selection_filter = Custom[Generate Selection Filter](VARCreateSelectionFilter=n05_create_selection_filter, VARFilterNametoCreate=n06_filter_name_to_create, VAROverwriteExistingFilter=n07_overwrite_existing_filter, VARElements=byOutlineTypeAndLevel)  # package Synthesize toolkit; Generate Selection FIlter
curves = PolyCurve.Curves(polyCurve=flatten_3)
startPoint = Curve.StartPoint(curve=curves)
isNull = Object.IsNull(object=byOutlineTypeAndLevel)
filterByBoolMask = List.FilterByBoolMask(list=startPoint, mask=isNull)
filterByBoolMask_2 = List.FilterByBoolMask(list=byOutlineTypeAndLevel, mask=isNull)
slabShapeByPoints = Custom[CW.Floor.SlabShapeByPoints](VARpoints=filterByBoolMask.out@L2, VARfloor=filterByBoolMask_2.out@L1)  # package Synthesize toolkit; Transform a slab shape based on a list of XYZs. PLEASE NOTE: Will reset any previous edits on the slab shape.
debug_python = Custom[Debug Python]()  # package Synthesize toolkit; Debug Python
