# Dynamo graph Floors.Create By Model Lines.dyn (Dynamo 2.13.1.3887)
# author: karam@aecedx.com
# packages: Synthesize toolkit 12.5.1

# group: Input
n07_create_selection_filter = BoolSelector(true)  # "07.Create Selection Filter ?"; graph input
n08_filter_name_to_create = StringInput("Dynamo Floors By Boundary Lines")  # "08.Filter Name to Create"; graph input
n09_overwrite_existing_filter = BoolSelector(false)  # "09.Overwrite Existing Filter ? (False for Adding Elements)"; graph input
n03_floor_types = FloorTypes()  # "03.Floor Types"; nothing selected; graph input
n05_use_all_levels_ignores_levels = BoolSelector(true)  # "05.Use All Levels (Ignores Levels Selection Filter)"; graph input
fix_factor_depends_of_project = DoubleInput(1000)  # "Fix Factor (Depends of Project Units, 1 For meters for example, and 100 for Centimeters)"
n06_levels_selection_filter_to = StringInput("Levels Filter Name")  # "06.Levels Selection Filter to Read"; graph input
offset = DoubleInput(0)  # "02.Offset"; graph input
n04_consider_inner_model_lines_as = BoolSelector(false)  # "04.Consider Inner Model Lines As Opennings"; graph input
n01_select_floors_boundaries = DSModelElementsSelection()  # "01.Select Floors Boundaries"; nothing selected; graph input

floors_by_model_lines = Custom[Floors By Model Lines](VARCreateSelectionFilter=n07_create_selection_filter, VARFilterNametoCreate=n08_filter_name_to_create, VAROverwriteExistingFilter=n09_overwrite_existing_filter, VARFloorType=n03_floor_types, VARUseAllLevelsIgnoresLevelsSelectionFilter=n05_use_all_levels_ignores_levels, VARFixFactorDependsofProjectUnits1Formetersforexampleand100forCentimeters=fix_factor_depends_of_project, VARLevelsSelectionFiltertoRead=n06_levels_selection_filter_to, VAROffset=offset, VARConsiderInnerModelLinesAsOpennings=n04_consider_inner_model_lines_as, VARElement=n01_select_floors_boundaries)  # package Synthesize toolkit; Floors By Model Lines

# group: Report
n01_number_of_floors_created = Watch(floors_by_model_lines.VARNumberOfFloors)  # "01.Number of Floors Created"; graph output

debug_python = Custom[Debug Python]()  # package Synthesize toolkit; Debug Python
