# Dynamo graph Floors.Modify Sub Elements Match Edges .dyn "Floors.Modify Sub Elements Match Edges" (Dynamo 2.13.1.3887)
# author: karam@aecedx.com
# packages: Synthesize toolkit 12.5.1

n01_select_floor_roof_1 = DSModelElementSelection()  # "01.Select Floor/Roof 1"; nothing selected; graph input
n02_select_floor_roof_1 = DSModelElementSelection()  # "02.Select Floor/Roof 1"; nothing selected; graph input
original = Custom[SP.Collector.ElementSketch.Original](VARelement=n02_select_floor_roof_1)  # package Synthesize toolkit; Get the actual sketch lines of a sketch based element (floor, ceiling, modified wall, etc.) . You can optionally fetch the matching model curves, however this might prove comptationally heavy on larger data sets. Does not work with elements from linked files.
startPoint = Curve.StartPoint(curve=original.VARcurves)
flatten = List.Flatten(list=startPoint)
slabShapeByPoints = Custom[CW.Roof.SlabShapeByPoints](VARpoints=flatten, VARroof=n02_select_floor_roof_1)  # package Synthesize toolkit; Transform a slab shape based on a list of XYZs. PLEASE NOTE: Will reset any previous edits on the slab shape.
end = Revit.Transaction.Transaction.End(input=slabShapeByPoints)
firstItem = List.FirstItem(list=end)
matchPoints = Custom[LF.SlabShape.MatchPoints](VARFloor1=n01_select_floor_roof_1, VARFloor2=firstItem)  # package Synthesize toolkit; Match the adjacent slab shape points from Floor 1 to Floor 2. (requires Clockwork package)
debug_python = Custom[Debug Python]()  # package Synthesize toolkit; Debug Python
