# Dynamo graph FormIt.K-Paneling Glazed.dyn (Dynamo 2.13.1.3887)
# author: karam@aecedx.com
# packages: Synthesize toolkit 12.5.1

# group: Input
selectFromFormIt = FormItSelectionNode(ButtonText="Select From FormIt")  # "01.FormIt.SelectFromFormIt"; graph input
n02_faces_offset = DoubleInput(0)  # "02.Faces Offset"; graph input
n09_border_depth = DoubleInput(0.2)  # "09.Border Depth"; graph input
n08_border_width = DoubleInput(0.1)  # "08.Border Width"; graph input
n04_number_distance_u = DoubleInput(5)  # "04.Number/Distance U"; graph input
n06_number_distance_v = DoubleInput(5)  # "06.Number/Distance V"; graph input
n03_u_spacing_method_false_by = BoolSelector(false)  # "03.U Spacing Method (False = By Number | True = Spacing)"; graph input
n05_v_spacing_method_false_by = BoolSelector(false)  # "05.V Spacing Method (False = By Number | True = Spacing)"; graph input
n11_u_mullion_width = DoubleInput(0.2)  # "11.U Mullion Width"; graph input
n12_u_mullion_depth = DoubleInput(0.15)  # "12.U Mullion Depth"; graph input
n14_v_mullion_width = DoubleInput(0.2)  # "14.V Mullion Width"; graph input
n15_v_mullion_depth = DoubleInput(0.1)  # "15.V Mullion Depth"; graph input
n18_panels_thickness = DoubleInput(0.03)  # "18.Panels Thickness"; graph input
n16_create_panels = BoolSelector(true)  # "16.Create Panels ?"; graph input
n10_u_offset = DoubleInput(0)  # "10.U Offset"; graph input
n13_v_offset = DoubleInput(0)  # "13.V Offset"; graph input
n17_panels_offset = DoubleInput(0)  # "17.Panels Offset"; graph input
n07_border_offset = DoubleInput(0)  # "07.Border Offset"; graph input

explode = Geometry.Explode(geometry=selectFromFormIt)
flatten = List.Flatten(list=explode)
python_script = Python(IN[0]=flatten, IN[1]=n02_faces_offset)  # IronPython2
# ---------- python_script.python (95 lines) ----------
# Enable Python support and load DesignScript library
# IMPORTANT : ALL DYNAMO DESIGN SCRIPT NODES ARE AS (dg)
import clr
clr.AddReference('ProtoGeometry')
from Autodesk.DesignScript import Geometry as dg

# Enable ICollection List Translate
clr.AddReference("System")
import System.Collections.Generic
from System.Collections.Generic import List

surfaces = IN[0]
offsetvalue = IN[1]

fixedlist = []
for s in surfaces:
	fixedlist.append(s)
surfaces = fixedlist

def joinonesurf(surfaces):
	backuplist = []
	for s in surfaces:
		backuplist.append(s)
	surftojoin = surfaces.pop(0)
	counter = 0
	result = []
	for s in surfaces:
		bbox1 = s.BoundingBox
		bbox2 = surftojoin.BoundingBox
		if dg.BoundingBox.Intersects(bbox1, bbox2):
			if dg.Geometry.DoesIntersect(surftojoin,s):
				try:
					result = dg.Surface.ByUnion([surftojoin,s])
				except:
					result = dg.PolySurface.ByJoinedSurfaces([surftojoin,s])
				break
		counter += 1
	if result != []:
		surfaces.append(result)
		surfaces.pop(counter)
	else:
		surfaces = rotate(backuplist,-1)
	totallystop = True
	for s in surfaces:
		for s1 in surfaces:
			if dg.Geometry.DoesIntersect(s,s1) and s != s1:
				totallystop = False
				break
		if totallystop == False:
			break
	return surfaces,totallystop
	
def rotate(l, n):
    return l[n:] + l[:n]

def flatten(x):
    result = []
    for el in x:
        if hasattr(el, "__iter__") and not isinstance(el, basestring):
            result.extend(flatten(el))
        else:
            result.append(el)
    return result

if offsetvalue > 0:
	totallystop = False
	while totallystop == False:
		doit = joinonesurf(surfaces)
		surfaces = doit[0]
		totallystop = doit[1]
	
	finalsurfaces = []
	for s in surfaces:
		try:
			offset = dg.Surface.Offset(s,0)
			offset.Dispose()
			finalsurfaces.append(s)
		except:
			exploded = dg.Geometry.Explode(s)
			finalsurfaces.append(exploded)
	
	finalsurfaces = flatten(finalsurfaces)
	
	offset = []
	for f in finalsurfaces:
		try:
			offset.append(dg.Geometry.Explode(dg.Surface.Offset(f,offsetvalue)))
		except:
			pass
	offset = flatten(offset)
else:
	offset = surfaces

# Assign your output to the OUT variable.
OUT = offset
# ----------------------------------------
explode_2 = Geometry.Explode(geometry=python_script)
flatten_2 = List.Flatten(list=explode_2)
count = List.Count(list=flatten_2)
cycle = List.Cycle(list=n04_number_distance_u, amount=count)
cycle_2 = List.Cycle(list=n06_number_distance_v, amount=count)
k_paneling_sandbox = Custom[K-Paneling Sandbox](VARSurfaces=flatten_2, VARBorderDepth=n09_border_depth, VARBorderWidth=n08_border_width, VARDistanceU=cycle, VARDistanaceV=cycle_2, VARMethodU=n03_u_spacing_method_false_by, VARMethodV=n05_v_spacing_method_false_by, VARUWidth=n11_u_mullion_width, VARUDepth=n12_u_mullion_depth, VARVWidth=n14_v_mullion_width, VARVDepth=n15_v_mullion_depth, VARPanelThickness=n18_panels_thickness, VARCreatePanels=n16_create_panels, VARUOffset=n10_u_offset, VARVOffset=n13_v_offset, VARPanelOffset=n17_panels_offset, VARBorderOffset=n07_border_offset)  # package Synthesize toolkit; K-Paneling
code_block = CodeBlock { 0; 1; 2; }

# group: Mullions
getItemAtIndex = List.GetItemAtIndex(list=k_paneling_sandbox, index=code_block.out0)

code_block_2 = CodeBlock { false; }
clean = List.Clean(list=getItemAtIndex, preserveIndices=code_block_2)
flatten_3 = List.Flatten(list=clean)
code_block_3 = CodeBlock { false; }
setAsMesh = FormItGroupOptions.SetAsMesh(SetAsMesh=code_block_3)
sendToFormIt = BakeNodeWithOptionsNodeModel(geometry=flatten_3, FormItGroupOptions=setAsMesh)  # graph output

# group: Panels
getItemAtIndex_2 = List.GetItemAtIndex(list=k_paneling_sandbox, index=code_block.out1)

clean_2 = List.Clean(list=getItemAtIndex_2, preserveIndices=code_block_2)
flatten_4 = List.Flatten(list=clean_2)
sendToFormIt_2 = BakeNodeWithOptionsNodeModel(geometry=flatten_4, FormItGroupOptions=setAsMesh)  # graph output

# group: Frames
getItemAtIndex_3 = List.GetItemAtIndex(list=k_paneling_sandbox, index=code_block.out2)

clean_3 = List.Clean(list=getItemAtIndex_3, preserveIndices=code_block_2)
flatten_5 = List.Flatten(list=clean_3)
sendToFormIt_3 = BakeNodeWithOptionsNodeModel(geometry=flatten_5, FormItGroupOptions=setAsMesh)  # graph output
