# Dynamo graph FormIt.K-Slicer By Solid and Line.dyn (Dynamo 2.13.1.3887)
# author: karam@aecedx.com
# packages: Synthesize toolkit 12.5.1

# group: Input
n05_union_pieces = BoolSelector(false)  # "05.Union Pieces ?"; graph input
thickness = DoubleInput(0.5)  # "03.Thickness"; graph input
n04_thicken_both_sides = BoolSelector(true)  # "04.Thicken Both Sides ?"; graph input
selectFromFormIt = FormItSelectionNode(ButtonText="Select From FormIt")  # "01.FormIt.SelectFromFormIt"; graph input
n06_exclusion_threshold = DoubleInput(10)  # "06.Exclusion Threshold"; graph input
n02_number_of_slices = DoubleInput(12)  # "02.Number of Slices"; graph input

code_block = CodeBlock { "Solid"; }
byClassName = Custom[SP.Filter.ByClassName](VARobject=selectFromFormIt, VARclassName=code_block)  # package Synthesize toolkit; Filters a list of objects by the object's class name. Note that Dynamo elements belong to different classes than their Revit counterparts. Use the Object.Class node to check an object's class.
firstItem = List.FirstItem(list=byClassName.VARout)
solid_by_curve_slicer = Custom[Solid By Curve Slicer](VARUnionPieces=n05_union_pieces, VARthickness=thickness, VARthickenbothsides=n04_thicken_both_sides, VARGeometry=byClassName.VARin, VARCurve=firstItem, VARExclusionThreshold=n06_exclusion_threshold, VARNumberofSlices=n02_number_of_slices)  # package Synthesize toolkit; Solid By Face Reference Slicer
flatten = List.Flatten(list=solid_by_curve_slicer)
code_block_2 = CodeBlock { false; }
setAsMesh = FormItGroupOptions.SetAsMesh(SetAsMesh=code_block_2)
sendToFormIt = BakeNodeWithOptionsNodeModel(geometry=flatten, FormItGroupOptions=setAsMesh)  # graph output
