# Dynamo graph Groups.Delete Bruteforce.dyn (Dynamo 2.13.1.3887)
# author: karam@aecedx.com
# packages: Synthesize toolkit 12.5.1

# group: Input
n03_proceed = BoolSelector(false)  # "03.Proceed ?"; graph input
n01_group_to_bruteforce_delete = StringInput("Group 1")  # "01.Group to Bruteforce Delete - Leave Empty To Delete All"; graph input
n02_exact_name_false_contains = BoolSelector(false)  # "02.Exact Name = False | Contains Name = True"; graph input

toLower = String.ToLower(string=n01_group_to_bruteforce_delete)
code_block = CodeBlock { ""; }
eq = toLower == code_block
element_types = ElementTypes("GroupType")
all_elements_of_type = ElementsOfType(element_type=element_types)
code_block_2 = CodeBlock { "Type Name"; }
getParameterValueByName = Element.GetParameterValueByName(element=all_elements_of_type, parameterName=code_block_2)
toLower_2 = String.ToLower(string=getParameterValueByName)
contains = String.Contains(string=toLower_2, searchFor=toLower)
eq_2 = contains == toLower
eq_3 = toLower_2 == toLower
scopeIf = Custom[CW.ScopeIf+](VARtest=n02_exact_name_false_contains, VARtrue=eq_2, VARfalse=eq_3)  # package Synthesize toolkit; A (hopefully) more robust implementation of ScopeIf. Tests a single boolean and returns a value accordingly.
filterByBoolMask = List.FilterByBoolMask(list=all_elements_of_type, mask=scopeIf)
scopeIf_2 = Custom[CW.ScopeIf+](VARtest=eq, VARtrue=all_elements_of_type, VARfalse=filterByBoolMask.in)
filterByBoolMask_2 = List.FilterByBoolMask(list=all_elements_of_type, mask=scopeIf)
scopeIf_3 = Custom[CW.ScopeIf+](VARtest=eq, VARtrue=all_elements_of_type, VARfalse=filterByBoolMask_2.in)
flatten = List.Flatten(list=scopeIf_3)
code_block_3 = CodeBlock { "Family Name"; }
getParameterValueByName_2 = Element.GetParameterValueByName(parameterName=code_block_3)  # unwired: element
groupByFunction = List.GroupByFunction(list=flatten, groupFunction=getParameterValueByName_2)
list_firstitem_fixer = Custom[List.FirstItem Fixer](VARlist=groupByFunction)  # package Synthesize toolkit; List.FirstItem Fixer
python_null_2_empty = Custom[Python Null 2 Empty](VARIN=list_firstitem_fixer)  # package Synthesize toolkit; Python Null 2 Empty
code_block_4 = CodeBlock { "Type Name"; }
getParameterValueByName_3 = Element.GetParameterValueByName(element=python_null_2_empty, parameterName=code_block_4)
modelGroupByName = Custom[RH.Collector.ModelGroupByName](VARgroupName=getParameterValueByName_3)  # package Synthesize toolkit; This will collect all instances of a model group by given name.
flatten_2 = List.Flatten(list=modelGroupByName)
list_firstitem_fixer_2 = Custom[List.FirstItem Fixer](VARlist=groupByFunction)
python_null_2_empty_2 = Custom[Python Null 2 Empty](VARIN=list_firstitem_fixer_2)
getParameterValueByName_4 = Element.GetParameterValueByName(element=python_null_2_empty_2, parameterName=code_block_4)
detailGroupByName = Custom[RH.Collector.DetailGroupByName](VARgroupName=getParameterValueByName_4)  # package Synthesize toolkit; This will collect all instances of a model group by given name.
flatten_3 = List.Flatten(list=detailGroupByName)
create = List.Create(item0=flatten_2, item1=flatten_3)
code_block_5 = CodeBlock { false; }
clean = List.Clean(list=create, preserveIndices=code_block_5)
flatten_4 = List.Flatten(list=clean)
code_block_6 = CodeBlock { null; }
scopeIf_4 = Custom[CW.ScopeIf+](VARtest=n03_proceed, VARtrue=flatten_4, VARfalse=code_block_6)
eraser = Custom[ST.Tool.Eraser](VARList=scopeIf_4)  # package Synthesize toolkit; Try to delete any element from project
passthrough = Custom[CW.Passthrough](VARpassThrough=scopeIf_2, VARwaitFor=eraser)  # package Synthesize toolkit; Forces a sequential order of execution. The node wired into the output of the Passthrough node will be executed *after* the node wired into the waitFor input (e.g. important for some Revit operations). The value of the passThrough input will be passed on to the node wired into the output port of the Passthrough node.
flatten_5 = List.Flatten(list=passthrough)
scopeIf_5 = Custom[CW.ScopeIf+](VARtest=n03_proceed, VARtrue=flatten_5, VARfalse=code_block_6)
eraser_2 = Custom[ST.Tool.Eraser](VARList=scopeIf_5)
count = List.Count(list=scopeIf_2)
code_block_7 = CodeBlock { " / "; }
code_block_8 = CodeBlock { "Family Name"; }
getParameterValueByName_5 = Element.GetParameterValueByName(element=all_elements_of_type, parameterName=code_block_8)
code_block_9 = CodeBlock { 6; }
removeFromEnd = Custom[RA.String.RemoveFromEnd](VARStr=getParameterValueByName_5, VARNumberToRemove=code_block_9)  # package Synthesize toolkit; Remove characters from the end of a string by a given amount
code_block_10 = CodeBlock(a=getParameterValueByName, b=code_block_7, c=removeFromEnd) { a+b+c; }
filterByBoolMask_3 = List.FilterByBoolMask(list=code_block_10, mask=scopeIf)
scopeIf_6 = Custom[CW.ScopeIf+](VARtest=eq, VARtrue=code_block_10, VARfalse=filterByBoolMask_3.in)
isEmpty = List.IsEmpty(list=scopeIf_6)
code_block_11 = CodeBlock { "No Groups to Remove"; }
scopeIf_7 = Custom[CW.ScopeIf+](VARtest=isEmpty, VARtrue=code_block_11, VARfalse=scopeIf_6)
count_2 = List.Count(list=modelGroupByName@L2)
string_from_object = FromObject(obj=count_2)
code_block_12 = CodeBlock { " of & with : "; }
code_block_13 = CodeBlock { "Type"; }
getParameterValueByName_6 = Element.GetParameterValueByName(element=flatten_2, parameterName=code_block_13)
uniqueItems = List.UniqueItems(list=getParameterValueByName_6)
code_block_14 = CodeBlock { "Type Name"; }
getParameterValueByName_7 = Element.GetParameterValueByName(element=uniqueItems, parameterName=code_block_14)
code_block_15 = CodeBlock { 6; " / "; }
code_block_16 = CodeBlock { "Family Name"; }
getParameterValueByName_8 = Element.GetParameterValueByName(element=uniqueItems, parameterName=code_block_16)
removeFromEnd_2 = Custom[RA.String.RemoveFromEnd](VARStr=getParameterValueByName_8, VARNumberToRemove=code_block_15.out0)
code_block_17 = CodeBlock(a=getParameterValueByName_7, b=code_block_15.out1, c=removeFromEnd_2) { a+b+c; }
code_block_18 = CodeBlock(a=string_from_object, b=code_block_12, c=code_block_17) { a+b+c; }
count_3 = List.Count(list=detailGroupByName@L2)
string_from_object_2 = FromObject(obj=count_3)
getParameterValueByName_9 = Element.GetParameterValueByName(element=flatten_3, parameterName=code_block_13)
uniqueItems_2 = List.UniqueItems(list=getParameterValueByName_9)
getParameterValueByName_10 = Element.GetParameterValueByName(element=uniqueItems_2, parameterName=code_block_14)
code_block_19 = CodeBlock { 6; " / "; }
code_block_20 = CodeBlock { "Family Name"; }
getParameterValueByName_11 = Element.GetParameterValueByName(element=uniqueItems_2, parameterName=code_block_20)
removeFromEnd_3 = Custom[RA.String.RemoveFromEnd](VARStr=getParameterValueByName_11, VARNumberToRemove=code_block_19.out0)
code_block_21 = CodeBlock(a=getParameterValueByName_10, b=code_block_19.out1, c=removeFromEnd_3) { a+b+c; }
code_block_22 = CodeBlock(a=string_from_object_2, b=code_block_12, c=code_block_21) { a+b+c; }
create_2 = List.Create(item0=code_block_18, item1=code_block_22)
code_block_23 = CodeBlock { false; }
clean_2 = List.Clean(list=create_2, preserveIndices=code_block_23)
flatten_6 = List.Flatten(list=clean_2)
isEmpty_2 = List.IsEmpty(list=flatten_6)
code_block_24 = CodeBlock { "No Group Instances to Remove"; }
scopeIf_8 = Custom[CW.ScopeIf+](VARtest=isEmpty_2, VARtrue=code_block_24, VARfalse=flatten_6)

# group: Report
n01_number_of_groups_to_remove = Watch(count)  # "01.Number of Groups to Remove"; graph output
n02_groups_to_remove = Watch(scopeIf_7)  # "02.Groups to Remove"; graph output
n03_number_of_groups_instances_to = Watch(scopeIf_8)  # "03.Number of Groups Instances to Remove"; graph output

debug_python = Custom[Debug Python]()  # package Synthesize toolkit; Debug Python
