# Dynamo graph Groups.Rotation K-Attractor By Selection.dyn (Dynamo 2.13.1.3887)
# author: karam@aecedx.com
# packages: Synthesize toolkit 12.5.1

# group: Input
n05_select_attractors = DSModelElementsSelection()  # "05.Select Attractors"; nothing selected; graph input
n01_select_groups_to_k_attract = DSModelElementsSelection()  # "01.Select Groups to K-Attract Rotations"; nothing selected; graph input
n04_reverse_numbers = BoolSelector(false)  # "04.Reverse Numbers ?"; graph input
n10_proceed = BoolSelector(false)  # "10.Proceed ?"; graph input
normalize = BoolSelector(false)  # "06.Normalize"; graph input
n02_start_number = DoubleInput(0)  # "02.Start Number"; graph input
n03_sequence_steps = DoubleInput(15)  # "03.Sequence Steps"; graph input
n07_new_minimum_normalize_true = DoubleInput(0)  # "07.New Minimum (Normalize = True)"; graph input
n08_new_maximum_normalize_true = DoubleInput(90)  # "08.New Maximum (Normalize = True)"; graph input
rounding = DoubleInput(0.01)  # "09.Rounding"; graph input

code_block = CodeBlock { "Group"; }
filterByString = Custom[ST.List.FilterByString](VARlist=n01_select_groups_to_k_attract, VARString=code_block)  # package Synthesize toolkit; Filter a list by a string match
k_attractor_sorter = Custom[K-Attractor Sorter](VARAttractors=n05_select_attractors, VARElements=filterByString.VARMatch)  # package Synthesize toolkit; K-Attractor Sorter
count = List.Count(list=k_attractor_sorter.VARGroupedandSortedElements)
sequence = Sequence(start=n02_start_number, amount=count, step=n03_sequence_steps, lacing=Longest)
remapRange = Math.RemapRange(numbers=sequence, newMin=n07_new_minimum_normalize_true, newMax=n08_new_maximum_normalize_true)
scopeIf = Custom[CW.ScopeIf+](VARtest=normalize, VARtrue=remapRange, VARfalse=sequence)  # package Synthesize toolkit; A (hopefully) more robust implementation of ScopeIf. Tests a single boolean and returns a value accordingly.
roundToPrecision = Custom[CW.Math.RoundToPrecision](VARdbl=scopeIf, VARprecision=rounding)  # package Synthesize toolkit; Rounds a number to a specified precision
empty = List.Empty()
scopeIf_2 = Custom[CW.ScopeIf+](VARtest=n10_proceed, VARtrue=roundToPrecision, VARfalse=empty)
reverse = List.Reverse(list=scopeIf_2)
scopeIf_3 = Custom[CW.ScopeIf+](VARtest=n04_reverse_numbers, VARtrue=reverse, VARfalse=scopeIf_2)
groups_batch_rotation = Custom[Groups Batch Rotation](VARGroupInstance=k_attractor_sorter.VARGroupedandSortedElements@L2, VARRotations=scopeIf_3, lacing=Longest)  # package Synthesize toolkit; Revit Links Batch Placement
debug_python = Custom[Debug Python]()  # package Synthesize toolkit; Debug Python
reverse_2 = List.Reverse(list=roundToPrecision)
scopeIf_4 = Custom[CW.ScopeIf+](VARtest=n04_reverse_numbers, VARtrue=reverse_2, VARfalse=roundToPrecision)

# group: Result
n01_values_generated = Watch(scopeIf_4)  # "01.Values Generated"; graph output
