# Dynamo graph Groups.Rotation Randomize By Selection.dyn (Dynamo 2.13.1.3887)
# author: karam@aecedx.com
# packages: Synthesize toolkit 12.5.1

# group: Input
n01_select_groups_to_randomize = DSModelElementsSelection()  # "01.Select Groups to Randomize Rotations"; nothing selected; graph input
n02_minimum_random_rotation_angle = DoubleSlider(-30, range=-360..360 step 1)  # "02.Minimum Random Rotation Angle"; graph input
n03_maximum_random_rotation_angle = DoubleSlider(30, range=-360..360 step 1)  # "03.Maximum Random Rotation Angle"; graph input
n04_randomize_rounding = DoubleInput(0.01)  # "04.Randomize Rounding"; graph input

code_block = CodeBlock { "Group"; }
filterByString = Custom[ST.List.FilterByString](VARlist=n01_select_groups_to_randomize, VARString=code_block)  # package Synthesize toolkit; Filter a list by a string match
python_script = Python(IN[0]=n02_minimum_random_rotation_angle, IN[1]=n03_maximum_random_rotation_angle, IN[2]=n04_randomize_rounding, IN[3]=filterByString.VARMatch)  # IronPython2
# ---------- python_script.python (22 lines) ----------
import clr
clr.AddReference('ProtoGeometry')
from Autodesk.DesignScript.Geometry import *
import System
pf_path = System.Environment.GetFolderPath(System.Environment.SpecialFolder.ProgramFilesX86)
import sys
sys.path.append('%s\IronPython 2.7\Lib' %pf_path)

import random

minrand = IN[0]
maxrand = IN[1]
rounding = IN[2]
countlist = IN[3]

result = []

for c in countlist:
	result.append(round(random.uniform(minrand, maxrand)/rounding)*rounding)

#Assign your output to the OUT variable.
OUT = result
# ----------------------------------------
groups_batch_rotation = Custom[Groups Batch Rotation](VARGroupInstance=filterByString.VARMatch, VARRotations=python_script)  # package Synthesize toolkit; Revit Links Batch Placement
debug_python = Custom[Debug Python]()  # package Synthesize toolkit; Debug Python
