# Dynamo graph Groups.Type K-Attractor By Selection.dyn (Dynamo 2.13.1.3887)
# author: karam@aecedx.com
# packages: Synthesize toolkit 12.5.1

# group: Input
n02_select_attractors = DSModelElementsSelection()  # "02.Select Attractors"; nothing selected; graph input
n03_group_names_to_use_separate = StringInput("Group 1 , Group 2, Group 3")  # "03.Group Names to Use (Separate By Comma ,)"; graph input
n06_reverse_types = BoolSelector(false)  # "06.Reverse Types ?"; graph input
n04_balanced_rhythm_seed = BoolSelector(true)  # "04.Balanced Rhythm (Seed) ?"; graph input
n05_custom_seed_value = DoubleInput(0)  # "05.Custom Seed Value"; graph input
n07_proceed = BoolSelector(false)  # "07.Proceed ?"; graph input
n01_select_groups = DSModelElementsSelection()  # "01.Select Groups"; nothing selected; graph input

typeCollector = Custom[BVN.ModelGroup.TypeCollector]()  # package Synthesize toolkit; Returns all the types (not instances) from all model groups in the project
code_block = CodeBlock { "Type Name"; }
getParameterValueByName = Element.GetParameterValueByName(element=typeCollector, parameterName=code_block)
count = List.Count(list=getParameterValueByName)
ofRepeatedItem = List.OfRepeatedItem(item=typeCollector, amount=count)
code_block_2 = CodeBlock { ","; }
split = String.Split(string=n03_group_names_to_use_separate, separator0=code_block_2)
trimWhitespace = String.TrimWhitespace(string=split)
eq = trimWhitespace@L1 == getParameterValueByName
filterByBoolMask = List.FilterByBoolMask(list=ofRepeatedItem, mask=eq)
code_block_3 = CodeBlock { false; }
clean = List.Clean(list=filterByBoolMask.in, preserveIndices=code_block_3)
flatten = List.Flatten(list=clean)
modelGroupByName = Custom[RH.Collector.ModelGroupByName](VARgroupName=trimWhitespace)  # package Synthesize toolkit; This will collect all instances of a model group by given name.
detailGroupByName = Custom[RH.Collector.DetailGroupByName](VARgroupName=trimWhitespace)  # package Synthesize toolkit; This will collect all instances of a model group by given name.
create = List.Create(item0=modelGroupByName, item1=detailGroupByName)
code_block_4 = CodeBlock { false; }
clean_2 = List.Clean(list=create, preserveIndices=code_block_4)
flatten_2 = List.Flatten(list=clean_2)
k_attractor_for_groups = Custom[K-Attractor For Groups](VARAttractors=n02_select_attractors, VARgroupTypes=flatten, VARReverseTypes=n06_reverse_types, VARBalancedRhythmSeed=n04_balanced_rhythm_seed, VARCustomSeedValue=n05_custom_seed_value, VARProceed=n07_proceed, VARSelectedGroups=n01_select_groups, VARgroupInstances=flatten_2)  # package Synthesize toolkit; K-Attractor For Family Types

# group: Result
n01_balanced_seed_value = Watch(k_attractor_for_groups.VARBalancedSeedValue)  # "01.Balanced Seed Value"; graph output
n02_number_of_total_groups = Watch(k_attractor_for_groups.VARNumberofTotalGroups)  # "02.Number of Total Groups"; graph output
n03_types_order_to_use = Watch(k_attractor_for_groups.VARTypesOrdertoUse)  # "03.Types Order to Use"; graph output
n04_groups_to_select = Watch(k_attractor_for_groups.VARGroupstoselect)  # "04.Groups to select"; graph output

debug_python = Custom[Debug Python]()  # package Synthesize toolkit; Debug Python
