# Dynamo graph Join.Unjoin All In One.dyn (Dynamo 2.13.1.3887)
# author: karam@aecedx.com
# packages: Synthesize toolkit 12.5.1

# group: Input
n03_scan_ceilings = BoolSelector(true)  # "03.Scan Ceilings"; graph input
n04_scan_columns = BoolSelector(true)  # "04.Scan Columns"; graph input
n05_scan_floors = BoolSelector(true)  # "05.Scan Floors"; graph input
n06_scan_floors_slab_edges = BoolSelector(true)  # "06.Scan Floors - Slab Edges"; graph input
n07_scan_generic_models = BoolSelector(true)  # "07.Scan Generic Models"; graph input
n08_scan_mass = BoolSelector(false)  # "08.Scan Mass"; graph input
n09_scan_roofs = BoolSelector(true)  # "09.Scan Roofs"; graph input
n10_scan_roofs_fascias = BoolSelector(true)  # "10.Scan Roofs - Fascias"; graph input
n11_scan_roofs_gutters = BoolSelector(true)  # "11.Scan Roofs - Gutters"; graph input
n12_scan_roofs_roof_soffits = BoolSelector(true)  # "12.Scan Roofs - Roof Soffits"; graph input
n13_scan_structural_columns = BoolSelector(true)  # "13.Scan Structural Columns"; graph input
n14_scan_structural_foundations = BoolSelector(true)  # "14.Scan Structural Foundations"; graph input
n15_scan_structural_framing = BoolSelector(true)  # "15.Scan Structural Framing"; graph input
n16_scan_walls = BoolSelector(true)  # "16.Scan Walls"; graph input
n17_scan_walls_wall_sweeps = BoolSelector(true)  # "17.Scan Walls - Wall Sweeps"; graph input
n01_detection_mode_1_visible = IntegerSlider(1, range=1..3 step 1)  # "01.Detection Mode: 1 = Visible Elements Only | 2 = Visible Elements With All Project | 3 = All Project"; graph input
n02_unjoin_walls_with_walls_not = BoolSelector(false)  # "02.Unjoin Walls With Walls (Not Recommended)"; graph input
n18_scan_stairs = BoolSelector(true)  # "18.Scan Stairs"; graph input
n19_scan_stairs_supports = BoolSelector(true)  # "19.Scan Stairs Supports"; graph input

code_block = CodeBlock { true; }
k_join_all_in_one = Custom[K-Join All In One](VARCeilings=n03_scan_ceilings, VARColumns=n04_scan_columns, VARFloors=n05_scan_floors, VARFloorsSlabEdges=n06_scan_floors_slab_edges, VARGenericModels=n07_scan_generic_models, VARMass=n08_scan_mass, VARRoofs=n09_scan_roofs, VARRoofsFascias=n10_scan_roofs_fascias, VARRoofsGutters=n11_scan_roofs_gutters, VARRoofSoffits=n12_scan_roofs_roof_soffits, VARStructuralColumns=n13_scan_structural_columns, VARStructuralFoundations=n14_scan_structural_foundations, VARStructuralFraming=n15_scan_structural_framing, VARWalls=n16_scan_walls, VARWallSweeps=n17_scan_walls_wall_sweeps, VARDetectionMode=n01_detection_mode_1_visible, VARIncludeWallsWithWalls=n02_unjoin_walls_with_walls_not, VARStairs=n18_scan_stairs, VARStairsSupports=n19_scan_stairs_supports, VARUnjoinMode=code_block)  # package Synthesize toolkit; K-Join All In One
debug_python_no_message = Custom[Debug Python No Message]()  # package Synthesize toolkit; Debug Python
