# Dynamo graph Join.Unjoin Selection.dyn (Dynamo 2.13.1.3887)
# author: karam@aecedx.com
# packages: Synthesize toolkit 12.5.1

# group: Input
n01_elements_to_unjoin = DSModelElementsSelection()  # "01.Elements to Unjoin"; nothing selected; graph input
n03_unjoin_visible_elements_in = BoolSelector(false)  # "03.Unjoin Visible Elements in Active View Only ?"; graph input
n02_elements_to_unjoin_from = DSModelElementsSelection()  # "02.Elements to Unjoin From"; nothing selected; graph input

python_all_elements_in_active = Custom[Python All Elements In Active View]()  # package Synthesize toolkit; Python All Elements In Active View
unjoin_elements_smart = Custom[Unjoin Elements (Smart)](VARListtoUnjoin=n01_elements_to_unjoin, VARUnjoinVisibleElementsinActiveViewOnly=n03_unjoin_visible_elements_in, VARListtoUnjoinFrom=n02_elements_to_unjoin_from, VARAllElementsinActiveView=python_all_elements_in_active)  # package Synthesize toolkit; Unjoin Elements (Smart)
debug_python_no_message = Custom[Debug Python No Message]()  # package Synthesize toolkit; Debug Python
