# Dynamo graph Levels.Auto Rename.dyn (Dynamo 2.13.1.3887)
# author: karam@aecedx.com
# packages: Synthesize toolkit 12.5.1

# group: Input
n06_remove_0_s_ignores_no_of = BoolSelector(false)  # "06.Remove 0's (Ignores No of Digits)"; graph input
n02_prefix_to_add_can_be_empty = StringInput("Level ")  # "02.Prefix to Add (Can be Empty) ?"; graph input
n03_number_sequence_start = DoubleInput(1)  # "03.Number Sequence Start"; graph input
n05_no_of_digits = DoubleSlider(2, range=1..3 step 1)  # "05.No.of Digits"; graph input
n07_reverse_naming = BoolSelector(false)  # "07.Reverse Naming"; graph input
n04_suffix_to_add_can_be_empty = StringInput("")  # "04.Suffix to Add (Can be Empty) ?"; graph input

rh_pick_model_elements = Custom[RH.Pick Model Elements]()  # package Synthesize toolkit; This node offers a pick method for selecting elements in Revit.
code_block = CodeBlock { "Level"; }
byClassName = Custom[SP.Filter.ByClassName](VARobject=rh_pick_model_elements, VARclassName=code_block)  # package Synthesize toolkit; Filters a list of objects by the object's class name. Note that Dynamo elements belong to different classes than their Revit counterparts. Use the Object.Class node to check an object's class.
count = List.Count(list=byClassName.VARin)
code_block_2 = CodeBlock { 1; }
sequence = Sequence(start=n03_number_sequence_start, amount=count, step=code_block_2, lacing=Longest)
code_block_3 = CodeBlock(level=n02_prefix_to_add_can_be_empty, number=sequence) { level+number; }
python_script = Python(IN[0]=n05_no_of_digits)  # IronPython2
# ---------- python_script.python (16 lines) ----------
import clr
clr.AddReference('ProtoGeometry')
from Autodesk.DesignScript.Geometry import *
#The inputs to this node will be stored as a list in the IN variable.
precision = IN[0]



if precision == 1:
  OUT = 0.1
elif precision == 2:
  OUT = 0.01
elif precision == 3:
  OUT = 0.001
else:
  raise Exception("Invalid precision input!")
# ----------------------------------------
mul = n03_number_sequence_start * python_script
sequence_2 = Sequence(start=mul, amount=count, step=python_script, lacing=Longest)
string_from_object = FromObject(obj=sequence_2)
number = DoubleInput(2)
substring = String.Substring(string=string_from_object, startIndex=number, length=n05_no_of_digits)
code_block_4 = CodeBlock(level=n02_prefix_to_add_can_be_empty, number=substring) { level+number; }
scopeIf = Custom[CW.ScopeIf+](VARtest=n06_remove_0_s_ignores_no_of, VARtrue=code_block_3, VARfalse=code_block_4)  # package Synthesize toolkit; A (hopefully) more robust implementation of ScopeIf. Tests a single boolean and returns a value accordingly.
eq = scopeIf@L1 == scopeIf
countTrue = List.CountTrue(list=eq@L2)
code_block_5 = CodeBlock { 1; }
gt = countTrue > code_block_5
anyTrue = Custom[CW.List.AnyTrue](VARseq=gt)  # package Synthesize toolkit; Returns true if any item in a list of booleans is true.
code_block_6 = CodeBlock { 0; }
withLeadingZeroes = Custom[CW.List.WithLeadingZeroes](VARnum=code_block_6, VARn=n05_no_of_digits)  # package Synthesize toolkit; Adds leading zeros to a sequence of numbers
scopeIf_2 = Custom[CW.ScopeIf+](VARtest=n06_remove_0_s_ignores_no_of, VARtrue=sequence, VARfalse=substring)
code_block_7 = CodeBlock(a=n03_number_sequence_start) { a*-1; }
code_block_8 = CodeBlock { 1; }
code_block_9 = CodeBlock { 0; }
withLeadingZeroes_2 = Custom[CW.List.WithLeadingZeroes](VARnum=code_block_9, VARn=n05_no_of_digits)
string_from_object_2 = FromObject(obj=withLeadingZeroes_2)
code_block_10 = CodeBlock(a=code_block_8, b=string_from_object_2) { a+b; }
toNumber = String.ToNumber(string=code_block_10)
code_block_11 = CodeBlock(num=toNumber, a=count) { num-a; }
code_block_12 = CodeBlock(a=code_block_7, b=code_block_11) { a+b; }
itemAtIndex = Custom[SP.List.ItemAtIndex+](VARlist=scopeIf_2, VARindex=code_block_12)  # package Synthesize toolkit; Identical to the built in node but works with negative indices
eq_2 = withLeadingZeroes == itemAtIndex
join = List.Join(list0=anyTrue, list1=eq_2)
anyTrue_2 = Custom[CW.List.AnyTrue](VARseq=join)
code_block_13 = CodeBlock { null; }
code_block_14 = CodeBlock { "Elevation"; "Name"; }
getParameterValueByName = Element.GetParameterValueByName(element=byClassName.VARin, parameterName=code_block_14.out1)
contains = List.Contains(list=getParameterValueByName@L1, item=code_block_4, lacing=CrossProduct)
anyTrue_3 = Custom[CW.List.AnyTrue](VARseq=contains)
filterByBoolMask = List.FilterByBoolMask(list=byClassName.VARin, mask=anyTrue_3)
join_2 = List.Join(list0=filterByBoolMask.in, list1=filterByBoolMask.out)
flatten = List.Flatten(list=join_2)
scopeIf_3 = Custom[CW.ScopeIf+](VARtest=anyTrue_2, VARtrue=code_block_13, VARfalse=flatten)
code_block_15 = CodeBlock { false; }
clean = List.Clean(list=scopeIf_3, preserveIndices=code_block_15)
code_block_16 = CodeBlock { "Name"; }
count_2 = List.Count(list=flatten)
randomList = Math.RandomList(amount=count_2)
string_from_object_3 = FromObject(obj=randomList)
scopeIf_4 = Custom[CW.ScopeIf+](VARtest=anyTrue_2, VARtrue=code_block_13, VARfalse=string_from_object_3)
clean_2 = List.Clean(list=scopeIf_4, preserveIndices=code_block_15)
setParameterByName = Element.SetParameterByName(element=clean, parameterName=code_block_16, value=clean_2)
join_3 = List.Join(list0=setParameterByName, list1=filterByBoolMask.out)
uniqueItems = List.UniqueItems(list=join_3)
getParameterValueByName_2 = Element.GetParameterValueByName(element=uniqueItems, parameterName=code_block_14.out0)
sortIndexByValue = List.SortIndexByValue(list=getParameterValueByName_2)
getItemAtIndex = List.GetItemAtIndex(list=join_3, index=sortIndexByValue)
scopeIf_5 = Custom[CW.ScopeIf+](VARtest=anyTrue_2, VARtrue=code_block_13, VARfalse=getItemAtIndex)
code_block_17 = CodeBlock { false; }
clean_3 = List.Clean(list=scopeIf_5, preserveIndices=code_block_17)
scopeIf_6 = Custom[CW.ScopeIf+](VARtest=anyTrue_2, VARtrue=code_block_13, VARfalse=scopeIf)
clean_4 = List.Clean(list=scopeIf_6, preserveIndices=code_block_17)
code_block_18 = CodeBlock { ""; }
join_4 = String.Join(separator=code_block_18, string1=n04_suffix_to_add_can_be_empty)  # unwired: string0
map = List.Map(list=clean_4, f_x=join_4)
reverse = List.Reverse(list=map)
scopeIf_7 = Custom[CW.ScopeIf+](VARtest=n07_reverse_naming, VARtrue=reverse, VARfalse=map)
setParameterByName_2 = Element.SetParameterByName(element=clean_3, parameterName=code_block_16, value=scopeIf_7)
count_3 = List.Count(list=byClassName.VARin)
code_block_19 = CodeBlock { "Duplicated names found, Please Increase No.of Digits or Activate Remove 0's"; "No Duplicated Names found"; }
scopeIf_8 = Custom[CW.ScopeIf+](VARtest=anyTrue_2, VARtrue=code_block_19.out0, VARfalse=code_block_19.out1)

# group: Report
n01_number_of_selected_levels = Watch(count_3)  # "01.Number of Selected Levels"; graph output
report = Watch(scopeIf_8)  # "02.Report"; graph output

note = StringInput("""Press Play, Then Select Levels to Rename, And Click On Finish from The Option Bar.

-Karam Baki""")  # "01.Note"; graph input
debug_python_no_message = Custom[Debug Python No Message]()  # package Synthesize toolkit; Debug Python
