# Dynamo graph Lines.By Arcs of Splines with Divisions.dyn (Dynamo 2.13.1.3887)
# author: karam@aecedx.com
# packages: Synthesize toolkit 12.5.1

# group: Input
n01_select_lines = DSModelElementsSelection()  # "01.Select Lines"; nothing selected; graph input
n05_divisions_number_distance = DoubleInput(25)  # "05.Divisions Number/Distance"; graph input
n02_delete_original = BoolSelector(true)  # "02.Delete Original ?"; graph input
n03_let_dynamo_guess = BoolSelector(false)  # "03.Let Dynamo Guess ?"; graph input

n04_by_number_false_by_distance = BoolSelector(false)  # "04.By Number = False | By Distance = True"; graph input
python_script = Python(IN[0]=n01_select_lines, IN[1]=n04_by_number_false_by_distance, IN[2]=n05_divisions_number_distance, IN[3]=n02_delete_original, IN[4]=n03_let_dynamo_guess)  # IronPython2
# ---------- python_script.python (184 lines) ----------
# Created By Karam Baki : karam@aecedx.com
# Enable Python support and load DesignScript library
# IMPORTANT : ALL DYNAMO DESIGN SCRIPT NODES ARE AS (dg)
import clr
clr.AddReference('ProtoGeometry')
from Autodesk.DesignScript import Geometry as dg

# EXTENSION Enable ToDSType
clr.AddReference('RevitNodes')
import Revit
clr.ImportExtensions(Revit.Elements)

# Enable Revit Elements
from Revit.Elements import *

# EXTENSION Enable Geometry Conversion Methods
clr.ImportExtensions(Revit.GeometryConversion)

# Enable Revit API
clr.AddReference('RevitAPI')
from Autodesk.Revit.DB import *

# Enable DocumentManager and TransactionManager
clr.AddReference('RevitServices')
from RevitServices.Persistence import DocumentManager
from RevitServices.Transactions import TransactionManager

# EXTENSION Enable Geometry Conversion Methods
clr.ImportExtensions(Revit.GeometryConversion)

def tolist(obj1):
	if hasattr(obj1,'__iter__'): return obj1
	else: return [obj1]

def normalize(length,nostartend = False,twominonly = False):
	if length != None:
		if length <= 3 and twominonly == False:
			length = 4
		elif length <= 3 and twominonly == True:
			if length < 2:
				length = 2
		if nostartend:
			length += 2
		a = range(0,int(length))
		points = []
		amin, amax = min(a), max(a)
		item = []
		for val in a:
			item.append(float(val-amin) / float(amax-amin))
	else:
		item = [None]
	if nostartend == True:
		item.pop(0)
		item.pop(-1)
	return item

def fixcurve(crv,div):
	nums = normalize(div)
	pts = []
	for n in nums:
		pts.append(dg.Curve.PointAtParameter(crv,n))
	curve = dg.NurbsCurve.ByControlPoints(pts)
	return curve
	
def spltocurve(crv,numordis,distance):
	try:
		if "NurbsCurve" in crv.ToString() and distance != 0:
			if numordis:
				div = int(round(crv.Length/distance))
			else:
				div = int(distance)
			arcs = []
			increment = 1.0 / div
			try:
				tan = crv.TangentAtParameter(0)
			except:
				crv = fixcurve(crv,div*10)
				tan = crv.TangentAtParameter(0)
			for j in range(0, div):
				incstart = increment * j
				incend = increment * (j+1)
				ptstart = crv.PointAtParameter(incstart)
				ptend = crv.PointAtParameter(incend)
				try:
					arc = dg.Arc.ByStartPointEndPointStartTangent(ptstart,ptend,tan)
				except:
					arc = dg.Line.ByStartPointEndPoint(ptstart,ptend)
				arcs.append(arc)
				tan = arc.TangentAtParameter(1)
			joined = dg.PolyCurve.ByJoinedCurves(arcs)
			return joined,True
		else:
			return crv,False
	except:
		return crv,False

def levelplane(doc,workplane):
	splits = list(workplane.Split(":"))
	splits.pop(0)
	level = ":".join(splits).strip()
	if workplane.startswith("Level"):
		levs = FilteredElementCollector(doc).OfCategory(BuiltInCategory.OST_Levels).WhereElementIsNotElementType().ToElements()
	else:
		levs = FilteredElementCollector(doc).OfClass(ReferencePlane).WhereElementIsNotElementType().ToElements()
	for l in levs:
		if l.Name == level:
			wantedlevel = l
			break
	plane = SketchPlane.Create(doc, wantedlevel.Id)
	return plane

lists = UnwrapElement(tolist(IN[0]))
numordis = IN[1]
distance = IN[2]
delete = IN[3]
dynguess = IN[4]

opt1 = Options()
doc = DocumentManager.Instance.CurrentDBDocument
uidoc = DocumentManager.Instance.CurrentUIApplication.ActiveUIDocument
view = uidoc.ActiveView
TransactionManager.Instance.EnsureInTransaction(doc)
if doc.IsFamilyDocument: 
	doc_create = doc.FamilyCreate
else: 
	doc_create = doc.Create
for l in lists:
	try:
		geoms = l.get_Geometry(opt1)
		tmp = []
		for t in geoms:
			tmp.append(t.ToProtoType())
		geom = tmp[0]
		if "Detail" in l.ToString():
			splitcurve = spltocurve(geom,numordis,distance)
			if dynguess:
				splitted = dg.Curve.ApproximateWithArcAndLineSegments(geom)
			else:
				splitted = dg.Geometry.Explode(splitcurve[0])
			if splitcurve[1]:
				for s in splitted:
					detline = doc_create.NewDetailCurve(view, s.ToRevitType())
					detline.LineStyle = l.LineStyle
				if delete:
					doc.Delete(l.Id)
		else:
			splitcurve = spltocurve(geom,numordis,distance)
			if dynguess:
				splitted = dg.Curve.ApproximateWithArcAndLineSegments(geom)
			else:
				splitted = dg.Geometry.Explode(splitcurve[0])
			if splitcurve[1]:
				workplane = l.get_Parameter(BuiltInParameter.SKETCH_PLANE_PARAM).AsString()
				if workplane.startswith("Level") or workplane.startswith("Reference Plane"):
					plane = levelplane(doc,workplane)
					for s in splitted:
						try:
							modline = doc_create.NewModelCurve(s.ToRevitType(),plane)
						except:
							modline = UnwrapElement(Revit.Elements.ModelCurve.ByCurve(s))
						modline.LineStyle = l.LineStyle
				else:
					for s in splitted:
						try:
							modline = UnwrapElement(Revit.Elements.ModelCurve.ByCurve(s))
						except:
							try:
								plane = SketchPlane.Create(doc,dg.PolyCurve.BasePlane(dg.PolyCurve.ByJoinedCurves(splitted)).ToPlane())
							except:
								joined = dg.PolyCurve.ByJoinedCurves(splitted)
								try:
									plane = SketchPlane.Create(doc,dg.Plane.ByBestFitThroughPoints(ptsGenerate(joined)).ToPlane())
								except:
									continue
							modline = doc_create.NewModelCurve(s.ToRevitType(),plane)
						modline.LineStyle = l.LineStyle
				if delete:
					doc.Delete(l.Id)
	except:
		pass
TransactionManager.Instance.TransactionTaskDone()

# Assign your output to the OUT variable.
OUT = "Done"
# ----------------------------------------
debug_python_no_message = Custom[Debug Python No Message]()  # package Synthesize toolkit; Debug Python
