# Dynamo graph Lines.By Auto Split.dyn (Dynamo 2.13.1.3887)
# author: karam@aecedx.com
# packages: Synthesize toolkit 12.5.1

# group: Input
n03_delete_original = BoolSelector(false)  # "03.Delete Original ?"; graph input
n01_select_lines_to_split = DSModelElementsSelection()  # "01.Select Lines to Split"; nothing selected; graph input
n06_detail_line_false_model_line = BoolSelector(true)  # "06.Detail Line = False | Model Line = True"; graph input
n05_takes_inside_false_takes = BoolSelector(false)  # "05.Takes Inside = False | Takes Outside = True (Works Only if Clean Up is on)"; graph input
n04_clean_up_mode = BoolSelector(false)  # "04.Clean Up Mode ?"; graph input
n02_select_splitting_lines = DSModelElementsSelection()  # "02.Select Splitting Lines"; nothing selected; graph input
n07_3d_snapping_mode_conceptual = BoolSelector(false)  # "07.3D Snapping Mode (Conceptual Environment)"; graph input
n09_is_reference = BoolSelector(false)  # "09.Is Reference ?"; graph input
n08_number_of_control_points_3d = DoubleInput(50)  # "08.Number of Control Points (3D Snapping Mode)"; graph input

generate_lines_by_autosplit = Custom[Generate Lines by AutoSplit](VARDeleteOriginal=n03_delete_original, VARLinestoSplit=n01_select_lines_to_split, VARDetailLine=n06_detail_line_false_model_line, VARTakesInside=n05_takes_inside_false_takes, VARCleanUpMode=n04_clean_up_mode, VARSplittingLines=n02_select_splitting_lines, VAR3DSnappingModeConceptualEnvironment=n07_3d_snapping_mode_conceptual, VARIsReference=n09_is_reference, VARNumberofControlPoints3DSnappingMode=n08_number_of_control_points_3d)  # package Synthesize toolkit; Generate Lines by AutoSplit
debug_python = Custom[Debug Python]()  # package Synthesize toolkit; Debug Python
