# Dynamo graph Lines.By Custom Offset or Fillet of Imported Geometry.dyn (Dynamo 2.13.1.3887)
# author: karam@aecedx.com
# packages: Synthesize toolkit 12.5.1

# group: Input
detail_lines_false_model_lines = BoolSelector(true)  # "Detail Lines = False | Model Lines = True"
n04_radius_or_chamfer_0_disables = DoubleInput(0)  # "04.Radius or Chamfer (0 Disables It)"; graph input
n05_offset_distance_0_disables_it = DoubleInput(0)  # "05.Offset Distance (0 Disables It)"; graph input
n01_select_imported_geometry = DSModelElementsSelection()  # "01.Select Imported Geometry"; nothing selected; graph input
n03_flip_for_arc_chamfer_mode = BoolSelector(true)  # "03.Flip (For Arc Chamfer Mode)"; graph input
n02_mode_1_fillet_2_arc_chamfer_3 = IntegerSlider(1, range=1..3 step 1)  # "02.Mode = 1 = Fillet | 2 = Arc Chamfer | 3 = Chamfer"; graph input

geometry = Element.Geometry(element=n01_select_imported_geometry)
flatten = List.Flatten(list=geometry)
code_block = CodeBlock { "Surface"; }
byClassName = Custom[SP.Filter.ByClassName](VARobject=flatten, VARclassName=code_block)  # package Synthesize toolkit; Filters a list of objects by the object's class name. Note that Dynamo elements belong to different classes than their Revit counterparts. Use the Object.Class node to check an object's class.
perimeterCurves = Surface.PerimeterCurves(surface=byClassName.VARin)
as_polycurve_bycurves = Custom[AS.[&] PolyCurve.ByCurves](VARcurves=perimeterCurves@L2)  # package Synthesize toolkit; Create polycurves from an unordered list of curves.
code_block_2 = CodeBlock { false; }
clean = List.Clean(list=as_polycurve_bycurves.VARpolyCurve, preserveIndices=code_block_2)
flatten_2 = List.Flatten(list=clean)
generate_offset_or_fillet_lines = Custom[Generate Offset or Fillet Lines](VARDetailLines=detail_lines_false_model_lines, VARRadiusorChamfer=n04_radius_or_chamfer_0_disables, VAROffsetDistance=n05_offset_distance_0_disables_it, VARPolyCurves=flatten_2, VARFlipForArcChamferMode=n03_flip_for_arc_chamfer_mode, VAR1Fillet2ArcChamfe3Chamfer=n02_mode_1_fillet_2_arc_chamfer_3)  # package Synthesize toolkit; Generate Offset or Fillet Lines
debug_python = Custom[Debug Python]()  # package Synthesize toolkit; Debug Python
