# Dynamo graph Lines.By Outlines of Elements Selection.dyn (Dynamo 2.13.1.3887)
# author: karam@aecedx.com
# packages: Synthesize toolkit 12.5.1

# group: Input
n08_create_selection_filter = BoolSelector(true)  # "08.Create Selection Filter ?"; graph input
n09_filter_name_to_create = StringInput("Dynamo Generated Outlines")  # "09.Filter Name to Create"; graph input
n10_overwrite_existing_filter = BoolSelector(false)  # "10.Overwrite Existing Filter ? (False for Adding Elements)"; graph input
n04_filter_by_orientation = BoolSelector(true)  # "04.Filter By Orientation ?"; graph input
n05_horizontal_up_1_horizontal = IntegerSlider(1, range=1..3 step 1)  # "05.Horizontal Up = 1 | Horizontal Down = 2 | Vertical = 3"; graph input
n01_select_model_elements = DSModelElementsSelection()  # "01.Select Model Elements"; nothing selected; graph input
n02_join_surfaces = BoolSelector(false)  # "02.Join Surfaces ?"; graph input
n07_level_to_pull_onto = Levels("Level 1")  # "07.Level to Pull Onto"; graph input
n06_pull_onto_level = BoolSelector(false)  # "06.Pull Onto Level ?"; graph input
offset = DoubleInput(0)  # "03.Offset"; graph input

code_block = CodeBlock { 1; 2; 3; }
eq = n05_horizontal_up_1_horizontal == code_block.out0
element_geometry_fixer = Custom[Element.Geometry Fixer](VARElement=n01_select_model_elements)  # package Synthesize toolkit; Element.Geometry Fixer
flatten = List.Flatten(list=element_geometry_fixer)
explode = Geometry.Explode(geometry=flatten)
flatten_2 = List.Flatten(list=explode)
code_block_2 = CodeBlock { "Surface"; }
byClassName = Custom[SP.Filter.ByClassName](VARobject=flatten_2, VARclassName=code_block_2)  # package Synthesize toolkit; Filters a list of objects by the object's class name. Note that Dynamo elements belong to different classes than their Revit counterparts. Use the Object.Class node to check an object's class.
filterByOrientation = Custom[CW.Surface.FilterByOrientation](VARsurfaces=byClassName.VARin)  # package Synthesize toolkit; Sorts surfaces in three lists based on their orientation (vertical, horizontal up & horizontal down) and also returns three corresponding lists of booleans.
code_block_3 = CodeBlock { null; false; }
clean = List.Clean(list=filterByOrientation.VARhorizontalUp, preserveIndices=code_block_3.out1)
scopeIf = Custom[CW.ScopeIf+](VARtest=eq, VARtrue=clean, VARfalse=code_block_3.out0)  # package Synthesize toolkit; A (hopefully) more robust implementation of ScopeIf. Tests a single boolean and returns a value accordingly.
eq_2 = n05_horizontal_up_1_horizontal == code_block.out1
clean_2 = List.Clean(list=filterByOrientation.VARhorizontalDown, preserveIndices=code_block_3.out1)
scopeIf_2 = Custom[CW.ScopeIf+](VARtest=eq_2, VARtrue=clean_2, VARfalse=code_block_3.out0)
eq_3 = n05_horizontal_up_1_horizontal == code_block.out2
clean_3 = List.Clean(list=filterByOrientation.VARvertical, preserveIndices=code_block_3.out1)
scopeIf_3 = Custom[CW.ScopeIf+](VARtest=eq_3, VARtrue=clean_3, VARfalse=code_block_3.out0)
create = List.Create(item0=scopeIf, item1=scopeIf_2, item2=scopeIf_3)
code_block_4 = CodeBlock { false; }
clean_4 = List.Clean(list=create, preserveIndices=code_block_4)
flatten_3 = List.Flatten(list=clean_4)
scopeIf_4 = Custom[CW.ScopeIf+](VARtest=n04_filter_by_orientation, VARtrue=flatten_3, VARfalse=byClassName.VARin)
flatten_4 = List.Flatten(list=scopeIf_4)
join_adjacent_surfaces = Custom[Join Adjacent Surfaces](VARSurfaces=flatten_4, VARJoinOrNot=n02_join_surfaces)  # package Synthesize toolkit; Join Adjacent Surfaces
generate_outlines_by_surface = Custom[Generate Outlines By Surface Selection](VARSurfaces=join_adjacent_surfaces, VARLevel=n07_level_to_pull_onto, VARPullOntoSelectedLevel=n06_pull_onto_level, VAROffset=offset)  # package Synthesize toolkit; Generate Outlines By Surface Selection
generate_selection_filter = Custom[Generate Selection Filter](VARCreateSelectionFilter=n08_create_selection_filter, VARFilterNametoCreate=n09_filter_name_to_create, VAROverwriteExistingFilter=n10_overwrite_existing_filter, VARElements=generate_outlines_by_surface)  # package Synthesize toolkit; Generate Selection FIlter
debug_python = Custom[Debug Python]()  # package Synthesize toolkit; Debug Python
