# Dynamo graph Lines.By Scale.dyn (Dynamo 2.13.1.3887)
# author: karam@aecedx.com
# packages: Synthesize toolkit 12.5.1

# group: Input
n10_detail_lines_false_model = BoolSelector(true)  # "10.Detail Lines = False | Model Lines = True"; graph input
n08_number_of_control_points_of = DoubleInput(10)  # "08.Number of Control Points of Forced to Nurbs Curves"; graph input
n09_delete_old = BoolSelector(false)  # "09.Delete Old ?"; graph input
n05_new_y = DoubleInput(1)  # "05.New Y"; graph input
n04_old_y = DoubleInput(1)  # "04.Old Y"; graph input
n03_new_x = DoubleInput(1)  # "03.New X"; graph input
n02_old_x = DoubleInput(1)  # "02.Old X"; graph input
n07_new_z = DoubleInput(1)  # "07.New Z"; graph input
n06_old_z = DoubleInput(1)  # "06.Old Z"; graph input
n01_select_cad_file_lines_to = DSModelElementsSelection()  # "01.Select CAD File / Lines to Scale"; nothing selected; graph input
n11_create_selection_filter = BoolSelector(true)  # "11.Create Selection Filter ?"; graph input
n12_selection_filter_name = StringInput("Dynamo Scaled Lines")  # "12.Selection Filter Name"; graph input

generate_scaled_lines = Custom[Generate Scaled Lines](VARDetailLines=n10_detail_lines_false_model, VARNumberofControlPointsofForcedtoNurbsCurves=n08_number_of_control_points_of, VARDeleteOld=n09_delete_old, VARNewY=n05_new_y, VAROldY=n04_old_y, VARNewX=n03_new_x, VAROldX=n02_old_x, VARNewZ=n07_new_z, VAROldZ=n06_old_z, VARCADFileLinestoScale=n01_select_cad_file_lines_to)  # package Synthesize toolkit; Generate Scaled Lines
n01_number_of_lines_forced_to_be = Watch(generate_scaled_lines.VARNumberofLinesForcedtoBeNurbs)  # "01.Number of Lines Forced to Be Nurbs"; graph output
code_block = CodeBlock { false; }
generate_selection_filter = Custom[Generate Selection Filter](VARCreateSelectionFilter=n11_create_selection_filter, VARFilterNametoCreate=n12_selection_filter_name, VAROverwriteExistingFilter=code_block, VARElements=generate_scaled_lines.VARElements)  # package Synthesize toolkit; Generate Selection FIlter
debug_python = Custom[Debug Python]()  # package Synthesize toolkit; Debug Python
