# Dynamo graph Lines.By Segmentation.dyn (Dynamo 2.13.1.3887)
# author: karam@aecedx.com
# packages: Synthesize toolkit 12.5.1

# group: Input
n02_delete_original = BoolSelector(true)  # "02.Delete Original ?"; graph input
n01_select_curves = DSModelElementsSelection()  # "01.Select Curves"; nothing selected; graph input
n06_detail_line_false_model_line = BoolSelector(false)  # "06.Detail Line = False | Model Line = True"; graph input
n04_simplify_lines = BoolSelector(true)  # "04.Simplify Lines ?"; graph input
n03_segmentate_each_line = BoolSelector(true)  # "03.Segmentate Each Line Separately"; graph input
n05_segmentation_distance = DoubleInput(5)  # "05.Segmentation Distance"; graph input

flatten = List.Flatten(list=n01_select_curves)
curves = Element.Curves(element=n01_select_curves)
isEmpty = List.IsEmpty(list=curves, lacing=Longest)
filterByBoolMask = List.FilterByBoolMask(list=flatten, mask=isEmpty)
code_block = CodeBlock { null; }
scopeIf = Custom[CW.ScopeIf+](VARtest=n02_delete_original, VARtrue=filterByBoolMask.out, VARfalse=code_block)  # package Synthesize toolkit; A (hopefully) more robust implementation of ScopeIf. Tests a single boolean and returns a value accordingly.
code_block_2 = CodeBlock { null; false; }
scopeIf_2 = Custom[CW.ScopeIf+](VARtest=n03_segmentate_each_line, VARtrue=curves, VARfalse=code_block_2.out0)
flatten_2 = List.Flatten(list=curves)
scopeIf_3 = Custom[CW.ScopeIf+](VARtest=n03_segmentate_each_line, VARtrue=code_block_2.out0, VARfalse=flatten_2)
create = List.Create(item0=scopeIf_2, item1=scopeIf_3)
clean = List.Clean(list=create, preserveIndices=code_block_2.out1)
flatten_3 = List.Flatten(list=clean@L2)
as_polycurve_bycurves = Custom[AS.[&] PolyCurve.ByCurves](VARcurves=flatten_3)  # package Synthesize toolkit; Create polycurves from an unordered list of curves.
lines_segmentation_by_distance = Custom[Lines Segmentation By Distance](VARCurves=as_polycurve_bycurves.VARpolyCurve, VARSegmentationDistance=n05_segmentation_distance)  # package Synthesize toolkit; Lines Segmentation By Distance
as_polycurve_bycurves_2 = Custom[AS.[&] PolyCurve.ByCurves](VARcurves=lines_segmentation_by_distance)
curves_2 = PolyCurve.Curves(polyCurve=as_polycurve_bycurves_2.VARpolyCurve)
simplify = Custom[SP.CurveLoop.Simplify](VARcurveLoop=curves_2@L2)  # package Synthesize toolkit; Attempts to simplify an open or a closed curve loop by connecting straight separate line segments into a single line.
code_block_3 = CodeBlock { null; }
scopeIf_4 = Custom[CW.ScopeIf+](VARtest=n04_simplify_lines, VARtrue=simplify, VARfalse=code_block_3)
flatten_4 = List.Flatten(list=lines_segmentation_by_distance)
curves_3 = PolyCurve.Curves(polyCurve=flatten_4)
scopeIf_5 = Custom[CW.ScopeIf+](VARtest=n04_simplify_lines, VARtrue=code_block_3, VARfalse=curves_3)
create_2 = List.Create(item0=scopeIf_4, item1=scopeIf_5)
code_block_4 = CodeBlock { false; }
clean_2 = List.Clean(list=create_2, preserveIndices=code_block_4)
flatten_5 = List.Flatten(list=clean_2)
code_block_5 = CodeBlock { "PolyCurve"; }
byClassName = Custom[SP.Filter.ByClassName](VARobject=flatten_5, VARclassName=code_block_5)  # package Synthesize toolkit; Filters a list of objects by the object's class name. Note that Dynamo elements belong to different classes than their Revit counterparts. Use the Object.Class node to check an object's class.
curves_4 = PolyCurve.Curves(polyCurve=byClassName.VARin)
create_3 = List.Create(item0=curves_4, item1=byClassName.VARout)
code_block_6 = CodeBlock { false; }
clean_3 = List.Clean(list=create_3, preserveIndices=code_block_6)
flatten_6 = List.Flatten(list=clean_3)
empty = List.Empty()
scopeIf_6 = Custom[CW.ScopeIf+](VARtest=n06_detail_line_false_model_line, VARtrue=flatten_6, VARfalse=empty)
byCurve = ModelCurve.ByCurve(curve=scopeIf_6)
passthrough = Custom[CW.Passthrough](VARpassThrough=scopeIf, VARwaitFor=byCurve)  # package Synthesize toolkit; Forces a sequential order of execution. The node wired into the output of the Passthrough node will be executed *after* the node wired into the waitFor input (e.g. important for some Revit operations). The value of the passThrough input will be passed on to the node wired into the output port of the Passthrough node.
eraser = Custom[ST.Tool.Eraser](VARList=passthrough)  # package Synthesize toolkit; Try to delete any element from project
scopeIf_7 = Custom[CW.ScopeIf+](VARtest=n06_detail_line_false_model_line, VARtrue=empty, VARfalse=flatten_6)
hot_get_revit_activeview = Custom[HOT.Get Revit ActiveView]()  # package Synthesize toolkit; Active View
fromCurve = Custom[CW.DetailLine.FromCurve](VARcurve=scopeIf_7, VARview=hot_get_revit_activeview)  # package Synthesize toolkit; Creates a detail line based on a given curve
debug_python = Custom[Debug Python]()  # package Synthesize toolkit; Debug Python
