# Dynamo graph Lines.By Simplify of Selection.dyn (Dynamo 2.13.1.3887)
# author: karam@aecedx.com
# packages: Synthesize toolkit 12.5.1

# group: Input
n01_select_curves = DSModelElementsSelection()  # "01.Select Curves"; nothing selected; graph input

curves = Element.Curves(element=n01_select_curves)
flatten = List.Flatten(list=curves)
al_group_curves = Custom[AL.Group Curves](VARCurves=flatten)  # package Synthesize toolkit; This node will take any input of flat list of curves and group them into sublists containing "joinable" curves that is continous curves. They might form closed curves or open curves. Use PolyCurve.ByJoinedCurves to convert output groups of curves into single PolyCurves
simplify = Custom[SP.CurveLoop.Simplify](VARcurveLoop=al_group_curves)  # package Synthesize toolkit; Attempts to simplify an open or a closed curve loop by connecting straight separate line segments into a single line.
byCurve = ModelCurve.ByCurve(curve=simplify@L2)
debug_python = Custom[Debug Python]()  # package Synthesize toolkit; Debug Python
