# Dynamo graph Lines.By Sketch of Element.dyn (Dynamo 2.13.1.3887)
# author: karam@aecedx.com
# packages: Synthesize toolkit 12.5.1

n01_select_elements = DSModelElementsSelection()  # "01.Select Elements"; nothing selected; graph input
original = Custom[SP.Collector.ElementSketch.Original](VARelement=n01_select_elements)  # package Synthesize toolkit; Get the actual sketch lines of a sketch based element (floor, ceiling, modified wall, etc.) . You can optionally fetch the matching model curves, however this might prove comptationally heavy on larger data sets. Does not work with elements from linked files.
code_block = CodeBlock { false; }
clean = List.Clean(list=original.VARcurves, preserveIndices=code_block)
flatten = List.Flatten(list=clean)
byCurve = ModelCurve.ByCurve(curve=flatten)
debug_python = Custom[Debug Python]()  # package Synthesize toolkit; Debug Python
