# Dynamo graph Lines.Join or Extract By Curves Selection.dyn (Dynamo 2.13.1.3887)
# author: karam@aecedx.com
# packages: Synthesize toolkit 12.5.1

# group: Input
n02_delete_original = BoolSelector(true)  # "02.Delete Original ?"; graph input
n01_select_curves = DSModelElementsSelection()  # "01.Select Curves"; nothing selected; graph input
n06_number_of_control_points = DoubleInput(15)  # "06.Number of Control Points Desired"; graph input
n05_with_points_conceptual = BoolSelector(false)  # "05.With Points ? (Conceptual Environment Only)"; graph input
n03_flatten_to_nearest_level = BoolSelector(false)  # "03.Flatten to Nearest Level ?"; graph input
n04_exact_same_curve_ignores = BoolSelector(false)  # "04.Exact Same Curve (Ignores Number of Control Points Desired) Useful for Converting Into Smart Lines, However it set to False, the Lines will try to Join"; graph input
n07_split_normalize_factor_exact = DoubleSlider(0.5, range=0..1 step 0.01)  # "07.Split Normalize Factor (Exact Same Line Must be Disabled, Works for Closed Loops Only)"; graph input
n08_detail_line_false_model_line = BoolSelector(true)  # "08.Detail Line = False | Model Line = True"; graph input

flatten = List.Flatten(list=n01_select_curves)
curves = Element.Curves(element=flatten)
isEmpty = List.IsEmpty(list=curves, lacing=Longest)
filterByBoolMask = List.FilterByBoolMask(list=flatten, mask=isEmpty)
flatten_2 = List.Flatten(list=curves)
generate_lines_helper_for_smart = Custom[Generate Lines (Helper for Smart Arcs Detection)](VARCurves=flatten_2, VARExactSameEdgeIgnoresNumberofControlPointsDesiredUsefulforConvertingIntoSmartLinesHoweveritsettoTruetheLineswilltrytoJoin=n04_exact_same_curve_ignores, VARWithPointsConceptualEnvironmentOnly=n05_with_points_conceptual)  # package Synthesize toolkit; Generate Lines (Helper for Smart Lines)
generate_lines_smart_with_auto = Custom[Generate Lines (Smart with Auto compatibility with Revit)](VARNumberofControlPointsPerLine=n06_number_of_control_points, VARWithPoints=n05_with_points_conceptual, VARFlattentoNearestLevel=n03_flatten_to_nearest_level, VARExactSameLineIgnoresNumberofControlPointsDesiredUsefulforConvertingIntoSmartLines=n04_exact_same_curve_ignores, VARSplitNormalizeFactorExactSameLineMustbeFasleWorksforClosedLoopsOnly=n07_split_normalize_factor_exact, VARCurves=generate_lines_helper_for_smart.VARCurves)  # package Synthesize toolkit; Generate Lines (Smart with Auto compatibility with Revit)
flatten_3 = List.Flatten(list=generate_lines_smart_with_auto.VARModelCurves)
passthrough = Custom[CW.Passthrough](VARpassThrough=filterByBoolMask.out, VARwaitFor=flatten_3)  # package Synthesize toolkit; Forces a sequential order of execution. The node wired into the output of the Passthrough node will be executed *after* the node wired into the waitFor input (e.g. important for some Revit operations). The value of the passThrough input will be passed on to the node wired into the output port of the Passthrough node.
code_block = CodeBlock { null; }
scopeIf = Custom[CW.ScopeIf+](VARtest=n02_delete_original, VARtrue=passthrough, VARfalse=code_block)  # package Synthesize toolkit; A (hopefully) more robust implementation of ScopeIf. Tests a single boolean and returns a value accordingly.
code_block_2 = CodeBlock { false; }
clean = List.Clean(list=scopeIf, preserveIndices=code_block_2)
eraser = Custom[ST.Tool.Eraser](VARList=clean)  # package Synthesize toolkit; Try to delete any element from project
create = List.Create(item0=generate_lines_smart_with_auto.VARModelCurves, item1=generate_lines_helper_for_smart.VARModelCurves)
model_line_or_detail_line_from = Custom[Model Line or Detail Line From (Model Line)](VARDetailLine=n08_detail_line_false_model_line, VARModelCurve=create)  # package Synthesize toolkit; Model Line or Detail Line From (Model Line)
debug_python_no_message = Custom[Debug Python No Message]()  # package Synthesize toolkit; Debug Python
