# Dynamo graph Lines.Join or Extract By Edges Selection.dyn (Dynamo 2.13.1.3887)
# author: karam@aecedx.com
# packages: Synthesize toolkit 12.5.1

# group: Input
n05_number_of_control_points = DoubleInput(15)  # "05.Number of Control Points Desired"; graph input
n04_with_points_conceptual = BoolSelector(false)  # "04.With Points ? (Conceptual Environment Only)"; graph input
n02_flatten_to_nearest_level = BoolSelector(false)  # "02.Flatten to Nearest Level ?"; graph input
n03_exact_same_edge_ignores = BoolSelector(false)  # "03.Exact Same Edge (Ignores Number of Control Points Desired) Useful for Converting Into Smart Lines, However it set to False, the Lines will try to Join"; graph input
n06_split_normalize_factor_exact = DoubleSlider(0.5, range=0..1 step 0.01)  # "06.Split Normalize Factor (Exact Same Line Must be Disabled, Works for Closed Loops Only)"; graph input
n01_select_edges = SelectEdges()  # "01.Select Edges"; nothing selected; graph input

generate_lines_helper_for_smart = Custom[Generate Lines (Helper for Smart Arcs Detection)](VARCurves=n01_select_edges, VARExactSameEdgeIgnoresNumberofControlPointsDesiredUsefulforConvertingIntoSmartLinesHoweveritsettoTruetheLineswilltrytoJoin=n03_exact_same_edge_ignores, VARWithPointsConceptualEnvironmentOnly=n04_with_points_conceptual)  # package Synthesize toolkit; Generate Lines (Helper for Smart Lines)
generate_lines_smart_with_auto = Custom[Generate Lines (Smart with Auto compatibility with Revit)](VARNumberofControlPointsPerLine=n05_number_of_control_points, VARWithPoints=n04_with_points_conceptual, VARFlattentoNearestLevel=n02_flatten_to_nearest_level, VARExactSameLineIgnoresNumberofControlPointsDesiredUsefulforConvertingIntoSmartLines=n03_exact_same_edge_ignores, VARSplitNormalizeFactorExactSameLineMustbeFasleWorksforClosedLoopsOnly=n06_split_normalize_factor_exact, VARCurves=generate_lines_helper_for_smart.VARCurves)  # package Synthesize toolkit; Generate Lines (Smart with Auto compatibility with Revit)

# group: Report
n01_number_of_lines_forced_to_be = Watch(generate_lines_smart_with_auto.VARNumberofLinesForcedToBeWithPointsUsedNumberofControlPoints)  # "01.Number of Lines Forced To Be With Points (Used Number of Control Points)"; graph output
n02_number_of_lines_forced_to_be = Watch(generate_lines_smart_with_auto.VARNumberofLinesForcedtoBeNotExactUsedNumberofControlPoints)  # "02.Number of Lines Forced to Be Not Exact (Used Number of Control Points)"; graph output
n03_number_of_lines_turned_into = Watch(generate_lines_helper_for_smart.VARNumberofLinesTurnedIntoArcs)  # "03.Number of Lines Turned Into Arcs"; graph output

debug_python_no_message = Custom[Debug Python No Message]()  # package Synthesize toolkit; Debug Python
