# Dynamo graph Links.Copy Elements From Links By Category.dyn (Dynamo 2.13.1.3887)
# author: karam@aecedx.com
# packages: Synthesize toolkit 12.5.1

debug_python_no_message = Custom[Debug Python No Message]()  # package Synthesize toolkit; Debug Python

# group: Input
n01_link_names_to_copy_from = StringInput("Link.rvt")  # "01.Link Names to Copy From (Separate By Comma ,)"; graph input
n02_category_to_copy = Categories("OST_StructuralColumns")  # "02.Category to Copy"; graph input
n03_filter_parameter_name = StringInput("")  # "03.Filter Parameter Name"; graph input
n04_filter_parameter_value = StringInput("")  # "04.Filter Parameter Value"; graph input
n05_custom_result_group_suffix = StringInput("")  # "05.Custom Result Group Suffix"; graph input
n06_generate_model_group = BoolSelector(true)  # "06.Generate Model Group ?"; graph input
n07_generate_void_family = BoolSelector(true)  # "07.Generate Void Family ?"; graph input
n08_generated_void_famiily = StringInput("C:\ProgramData\Autodesk\RVT 2023\Family Templates\English\Metric Generic Model.rft")  # "08.Generated Void Famiily Template"; graph input
n09_generated_void_family = Categories("OST_GenericModel")  # "09.Generated Void Family Category"; graph input

copyElementsFromLinksByCategory = Custom[CopyElementsFromLinksByCategory](VARLinkNamestoCopyFromSeparateByComma=n01_link_names_to_copy_from, VARCategorytoCopy=n02_category_to_copy, VARFilterParameterName=n03_filter_parameter_name, VARFilterParameterValue=n04_filter_parameter_value, VARCustomResultGroupSuffix=n05_custom_result_group_suffix, VARGenerateModelGroup=n06_generate_model_group, VARGenerateVoidFamily=n07_generate_void_family, VARFamilyTemplatePath=n08_generated_void_famiily, VARFamilyCategory=n09_generated_void_family)  # package Synthesize toolkit; CopyElementsFromLinksByCategory
elements = Watch(copyElementsFromLinksByCategory)  # graph output
