# Dynamo graph Materials.Legand Types Sync.dyn (Dynamo 2.13.1.3887)
# author: karam@aecedx.com
# packages: Synthesize toolkit 12.5.1

# group: Input
n01_legand_family_name_load = StringInput("Sample Legand Hatch Material Family")  # "01.Legand Family Name (Load Sample Legand Hatch Material Family.rfa From Extra Folder)"; graph input
n03_material_name_contains = StringInput("AECedx")  # "03.Material Name Contains"; graph input
n02_material_parameter_name = StringInput("Material")  # "02.Material Parameter Name"; graph input

byName = Family.ByName(name=n01_legand_family_name_load)
types = Family.Types(family=byName)
firstItem = List.FirstItem(list=types)
element_types = ElementTypes("Material")
all_elements_of_type = ElementsOfType(element_type=element_types)
name = Material.Name(material=all_elements_of_type)
contains = String.Contains(string=name, searchFor=n03_material_name_contains)
filterByBoolMask = List.FilterByBoolMask(list=name, mask=contains)
cw_duplicate_family_types = Custom[CW.Duplicate Family Types](VARElementTypes=firstItem, VARNames=filterByBoolMask.in, lacing=Longest)  # package Synthesize toolkit; Duplicates an element type
isEmpty = List.IsEmpty(list=cw_duplicate_family_types, lacing=Longest)
filterByBoolMask_2 = List.FilterByBoolMask(list=cw_duplicate_family_types, mask=isEmpty)
filterByBoolMask_3 = List.FilterByBoolMask(list=all_elements_of_type, mask=contains)
filterByBoolMask_4 = List.FilterByBoolMask(list=filterByBoolMask_3.in, mask=isEmpty)
setParameterByName = Element.SetParameterByName(element=filterByBoolMask_2.out, parameterName=n02_material_parameter_name, value=filterByBoolMask_4.out)
count = List.Count(list=setParameterByName)
n01_number_of_family_types = Watch(count)  # "01.Number of Family Types Created And Processed Successfully"; graph output
debug_python = Custom[Debug Python]()  # package Synthesize toolkit; Debug Python
