# Dynamo graph Materials.Override Material Assets.dyn (Dynamo 2.13.1.3887)
# author: karam@aecedx.com
# packages: Synthesize toolkit 12.5.1

# group: Input
n01_material_to_read_it_s_asset = StringInput("")  # "01.Material To Read It's ASSET For Overriding ?"; graph input
n03_extra_materials_to_exclude = StringInput("")  # "03.Extra Materials To Exclude From Override (Separate by Symbol)"; graph input
n04_separation_symbol = StringInput(",")  # "04.Separation Symbol"; graph input
n05_drafting_view_name_store = StringInput("Dynamo Materials Override Data")  # "05.Drafting View Name (Store Backup Data In)"; graph input
n02_auto_exclude_transparent = BoolSelector(true)  # "02.Auto Exclude Transparent Materials"; graph input
n06_prefix_to_add_to_overridden = StringInput("OVERRIDDEN_")  # "06.Prefix to Add to Overridden Materials"; graph input

override_material_assets = Custom[Override Material Assets](VARMaterialToReadItsASSETForOverriding=n01_material_to_read_it_s_asset, VARExtraMaterialsToExcludeFromOverride=n03_extra_materials_to_exclude, VARSeparator=n04_separation_symbol, VARDraftingViewName=n05_drafting_view_name_store, VARAutoExcludeTransparentMaterials=n02_auto_exclude_transparent, VARPrefix=n06_prefix_to_add_to_overridden)  # package Synthesize toolkit; Override Material Assets
debug_python_no_message = Custom[Debug Python No Message]()  # package Synthesize toolkit; Debug Python
