# Dynamo graph Parameter.Copy Parameters By Selection Filter.dyn (Dynamo 2.13.1.3887)
# author: karam@aecedx.com
# packages: Synthesize toolkit 12.5.1

# group: Input
n05_is_type_parameter = BoolSelector(false)  # "05.Is Type Parameter ?"; graph input
n03_selection_filter_to_read_and = StringInput("Selection Filter")  # "03.Selection Filter to Read and Map To"; graph input
n04_map_to_parameter = StringInput("")  # "04.Map To Parameter"; graph input
n01_selection_filter_to_read_and = StringInput("Selection Filter")  # "01.Selection Filter to Read and Copy From"; graph input
n02_copy_from_parameter = StringInput("Area")  # "02.Copy From Parameter"; graph input

hot_get_all_filter = Custom[HOT.Get All Filter]()  # package Synthesize toolkit; Get all Filter
toLower = String.ToLower(string=hot_get_all_filter.VARName)
trimWhitespace = String.TrimWhitespace(string=toLower)
toLower_2 = String.ToLower(string=n03_selection_filter_to_read_and)
trimWhitespace_2 = String.TrimWhitespace(string=toLower_2)
eq = trimWhitespace == trimWhitespace_2
filterByBoolMask = List.FilterByBoolMask(list=hot_get_all_filter.VARElement, mask=eq)
elements = Custom[CW.SelectionSet.Elements](VARselectionSet=filterByBoolMask.in)  # package Synthesize toolkit; Retrieves all elements stored in a selection set
flatten = List.Flatten(list=elements)
elementType = Element.ElementType(element=flatten)
uniqueItems = List.UniqueItems(list=elementType)
scopeIf = Custom[CW.ScopeIf+](VARtest=n05_is_type_parameter, VARtrue=uniqueItems, VARfalse=flatten)  # package Synthesize toolkit; A (hopefully) more robust implementation of ScopeIf. Tests a single boolean and returns a value accordingly.
hot_get_all_filter_2 = Custom[HOT.Get All Filter]()
toLower_3 = String.ToLower(string=hot_get_all_filter_2.VARName)
trimWhitespace_3 = String.TrimWhitespace(string=toLower_3)
toLower_4 = String.ToLower(string=n01_selection_filter_to_read_and)
trimWhitespace_4 = String.TrimWhitespace(string=toLower_4)
eq_2 = trimWhitespace_3 == trimWhitespace_4
filterByBoolMask_2 = List.FilterByBoolMask(list=hot_get_all_filter_2.VARElement, mask=eq_2)
elements_2 = Custom[CW.SelectionSet.Elements](VARselectionSet=filterByBoolMask_2.in)
flatten_2 = List.Flatten(list=elements_2)
elementType_2 = Element.ElementType(element=flatten_2)
uniqueItems_2 = List.UniqueItems(list=elementType_2)
scopeIf_2 = Custom[CW.ScopeIf+](VARtest=n05_is_type_parameter, VARtrue=uniqueItems_2, VARfalse=flatten_2)
parameter_copy = Custom[Parameter Copy](VARElementsToMapTo=scopeIf, VARMapToParameter=n04_map_to_parameter, VARElementsToCopyFrom=scopeIf_2, VARCopyFromParameter=n02_copy_from_parameter)  # package Synthesize toolkit; Parameter Copy
count = List.Count(list=parameter_copy)

# group: Report
n01_number_of_elements_mapped = Watch(count)  # "01.Number of Elements Mapped"; graph output

debug_python_no_message = Custom[Debug Python No Message]()  # package Synthesize toolkit; Debug Python
