# Dynamo graph Parameter.Depth Extend Into Topography By Family and Type.dyn (Dynamo 2.13.1.3887)
# author: karam@aecedx.com
# packages: Synthesize toolkit 12.5.1

# group: Credits
# note: Copyright (c) 2015, AECOM
# Written by: Matthew Anderle & Guy Mazzotta
# Fixed and Enhanced by : Karam Baki

# group: Input
n02_all_types_of_family_name = BoolSelector(true)  # "02.All Types of Family Name ? (False for Specific Type)"; graph input
n03_family_name = StringInput("M_Rectangular Column")  # "03.Family Name"; graph input
n04_specific_type_name_separate = StringInput("Type")  # "04.Specific Type Name (Separate by Comma , )"; graph input
code_block = CodeBlock { ","; }
n05_elements_in_active_view_only = BoolSelector(false)  # "05.Elements In Active View Only ?"; graph input
n07_depth_parameter = StringInput("Base Offset")  # "07.Depth Parameter"; graph input
is_minus_1 = BoolSelector(true)
n01_select_revit_topography = DSModelElementSelection()  # "01.Select Revit Topography"; nothing selected; graph input
n08_extra_depth_can_be_0 = DoubleInput(0)  # "08.Extra Depth (Can be 0)"; graph input
n06_level_parameter_name = StringInput("Base Level")  # "06.Level Parameter Name"; graph input

family_and_type_selector = Custom[Family and Type Selector](VARAllElementsofFamilyNameAlltypes=n02_all_types_of_family_name, VARFamilyName=n03_family_name, VARSpecificTypeNamesSeparatebySymbol=n04_specific_type_name_separate, VARSeparationSymbol=code_block, VAROnlyInActiveView=n05_elements_in_active_view_only)  # package Synthesize toolkit; Family and Type Selector
add = _ + _  # unwired: x, y
location = Custom[CW.Element.Location](VARelement=family_and_type_selector.VARElements)  # package Synthesize toolkit; Returns the location of an element as an XYZ (or if it's line-based the start and end point of the line), along with some booleans to help filtering the results. Use this for some element types (e.g. walls or lines) that do not work with the built-in Get Family Instance Location node.
Z = Point.Z(point=location.VARpoints)
getParameterValueByName = Element.GetParameterValueByName(element=family_and_type_selector.VARElements, parameterName=n07_depth_parameter)
subtract_returns_elevation_of = Z - getParameterValueByName  # "(subtract) Returns Elevation of Caisson at T/ Socket"
X = Point.X(point=location.VARpoints)
Y = Point.Y(point=location.VARpoints)
convert_topo_to_polysurface = CodeBlock(T=n01_select_revit_topography, x=X, y=Y)
# ---------- convert_topo_to_polysurface.designscript (8 lines) ----------
iA=List.GetItemAtIndex(T.Mesh.VertexPositions,T.Mesh.FaceIndices.A);
iB=List.GetItemAtIndex(T.Mesh.VertexPositions,T.Mesh.FaceIndices.B);
iC=List.GetItemAtIndex(T.Mesh.VertexPositions,T.Mesh.FaceIndices.C);
TopoSurf=PolySurface.ByJoinedSurfaces(Surface.ByPerimeterPoints(List.Transpose([iA,iB,iC])));

z=(TopoSurf.BoundingBox.MinPoint.Z)-10;
Point.ByCoordinates(x,y,z);
dir=Vector.ZAxis();
# ----------------------------------------
project = Point.Project(point=convert_topo_to_polysurface.out5, baseGeometry=convert_topo_to_polysurface.TopoSurf, projectionDirection=convert_topo_to_polysurface.dir)
Z_2 = Point.Z(point=project)
flatten = List.Flatten(list=Z_2)
sub = subtract_returns_elevation_of - flatten
combine = List.Combine(comb=add, list1=sub, list2=getParameterValueByName)
add_2 = combine + n08_extra_depth_can_be_0
getParameterValueByName_2 = Element.GetParameterValueByName(element=family_and_type_selector.VARElements, parameterName=n06_level_parameter_name)
projectElevation = Level.ProjectElevation(level=getParameterValueByName_2)
add_3 = add_2 + projectElevation
code_block_2 = CodeBlock { -1; }
mul = add_3 * code_block_2
scopeIf = Custom[CW.ScopeIf+](VARtest=is_minus_1, VARtrue=mul, VARfalse=add_3)  # package Synthesize toolkit; A (hopefully) more robust implementation of ScopeIf. Tests a single boolean and returns a value accordingly.
setParameterByName = Element.SetParameterByName(element=family_and_type_selector.VARElements, parameterName=n07_depth_parameter, value=scopeIf)
count = List.Count(list=setParameterByName)

# group: Report
n01_number_of_extended_elements = Watch(count)  # "01.Number of Extended Elements"; graph output
n02_values_used = Watch(scopeIf)  # "02.Values Used"; graph output

debug_python = Custom[Debug Python]()  # package Synthesize toolkit; Debug Python
