# Dynamo graph Parameter.Flip By Family and Type.dyn (Dynamo 2.13.1.3887)
# author: karam@aecedx.com
# packages: Synthesize toolkit 12.5.1

# group: Input
n02_all_elements_of_family_name = BoolSelector(true)  # "02.All Elements of Family Name (All types) ?"; graph input
n01_family_names_separate_by = StringInput("Family")  # "01.Family Names (Separate By Comma , - or * To Select All Matching)"; graph input
n03_specific_type_names_separate = StringInput("Type")  # "03.Specific Type Names (Separate by Comma , )"; graph input
n04_elements_in_active_view_only = BoolSelector(false)  # "04.Elements In Active View Only ?"; graph input
n06_name_of_parameters_to_flip = StringInput("Height")  # "06.Name of Parameters to Flip (Separate By Comma , or - * To Select All Matching)"; graph input
n05_is_type_parameter = BoolSelector(false)  # "05.Is Type Parameter ?"; graph input
n07_proceed = BoolSelector(false)  # "07.Proceed ?"; graph input

code_block = CodeBlock { ","; }
family_and_type_selector = Custom[Family and Type Selector](VARAllElementsofFamilyNameAlltypes=n02_all_elements_of_family_name, VARFamilyName=n01_family_names_separate_by, VARSpecificTypeNamesSeparatebySymbol=n03_specific_type_names_separate, VARSeparationSymbol=code_block, VAROnlyInActiveView=n04_elements_in_active_view_only)  # package Synthesize toolkit; Family and Type Selector
parameters_selector = Custom[Parameters Selector](VARElements=family_and_type_selector.VARElements, VARParameterNames=n06_name_of_parameters_to_flip, VARSeparationSymbol=code_block, VARIsTypeParam=n05_is_type_parameter)  # package Synthesize toolkit; Parameters Selector
flip_parameter_values = Custom[Flip Parameter Values](VARListofParameterstoFlip=parameters_selector, VARProceed=n07_proceed, VARElementstoWorkon=family_and_type_selector.VARElements, VARIsTypeParameters=n05_is_type_parameter)  # package Synthesize toolkit; Flip Parameter Values

# group: Report
n01_elements_to_select = Watch(flip_parameter_values.VARElementstoselect)  # "01.Elements to select"; graph output
n02_number_of_elements = Watch(flip_parameter_values.VARNumberofElements)  # "02.Number of Elements"; graph output

debug_python = Custom[Debug Python]()  # package Synthesize toolkit; Debug Python
