# Dynamo graph Parameter.Flip By Selection.dyn (Dynamo 2.13.1.3887)
# author: karam@aecedx.com
# packages: Synthesize toolkit 12.5.1

# group: Input
n01_select_elements_to_work_on = DSModelElementsSelection()  # "01.Select Elements to Work on"; nothing selected; graph input
n03_name_of_parameters_to_flip = StringInput("Height")  # "03.Name of Parameters to Flip (Separate By Comma , or - * To Select All Matching)"; graph input
n02_is_type_parameter = BoolSelector(false)  # "02.Is Type Parameter ?"; graph input
n04_proceed = BoolSelector(false)  # "04.Proceed ?"; graph input

code_block = CodeBlock { ","; }
parameters_selector = Custom[Parameters Selector](VARElements=n01_select_elements_to_work_on, VARParameterNames=n03_name_of_parameters_to_flip, VARSeparationSymbol=code_block, VARIsTypeParam=n02_is_type_parameter)  # package Synthesize toolkit; Parameters Selector
flip_parameter_values = Custom[Flip Parameter Values](VARListofParameterstoFlip=parameters_selector, VARProceed=n04_proceed, VARElementstoWorkon=n01_select_elements_to_work_on, VARIsTypeParameters=n02_is_type_parameter)  # package Synthesize toolkit; Flip Parameter Values

# group: Report
n01_elements_to_select = Watch(flip_parameter_values.VARElementstoselect)  # "01.Elements to select"; graph output
n02_number_of_elements = Watch(flip_parameter_values.VARNumberofElements)  # "02.Number of Elements"; graph output

debug_python = Custom[Debug Python]()  # package Synthesize toolkit; Debug Python
