# Dynamo graph Parameter.K-Attractor By Family and Type.dyn (Dynamo 2.13.1.3887)
# author: karam@aecedx.com
# packages: Synthesize toolkit 12.5.1

# group: Input
n02_all_elements_of_family_name = BoolSelector(true)  # "02.All Elements of Family Name (All types) ?"; graph input
n01_family_names_separate_by = StringInput("Family")  # "01.Family Names (Separate By Comma , - or * To Select All Matching)"; graph input
n03_specific_type_names_separate = StringInput("Type")  # "03.Specific Type Names (Separate by Comma , )"; graph input
n04_elements_in_active_view_only = BoolSelector(false)  # "04.Elements In Active View Only ?"; graph input
n05_select_attractors = DSModelElementsSelection()  # "05.Select Attractors"; nothing selected; graph input
n10_repeated_sequence_for_all = BoolSelector(true)  # "10.Repeated Sequence for All Parameters ?"; graph input
n09_reverse_numbers = BoolSelector(false)  # "09.Reverse Numbers ?"; graph input
n07_start_number = DoubleInput(1)  # "07.Start Number"; graph input
n08_sequence_steps = DoubleInput(0.1)  # "08.Sequence Steps"; graph input
normalize = BoolSelector(false)  # "11.Normalize"; graph input
n12_new_minimum_normalize_true = DoubleInput(0)  # "12.New Minimum (Normalize = True)"; graph input
n13_new_maximum_normalize_true = DoubleInput(1)  # "13.New Maximum (Normalize = True)"; graph input
n21_proceed = BoolSelector(false)  # "21.Proceed ?"; graph input
rounding = DoubleInput(0.01)  # "14.Rounding"; graph input
n15_additive = BoolSelector(false)  # "15.Additive ?"; graph input
n06_name_of_parameters_to_attract = StringInput("Height")  # "06.Name of Parameters to Attract (Separate By Comma , - or * To Select All Matching)"; graph input
n16_circle_preview_will_draw = BoolSelector(false)  # "16.Circle Preview (Will Draw Indicative Circles)"; graph input
n17_minimum_preview_circle_radius = DoubleInput(1)  # "17.Minimum Preview Circle Radius"; graph input
n18_maximum_preview_circle_radius = DoubleInput(5)  # "18.Maximum Preview Circle Radius"; graph input
n19_circles_perview_degree = DoubleInput(0)  # "19.Circles Perview Degree"; graph input
n20_circles_preview_plane_x_false = BoolSelector(false)  # "20.Circles Preview Plane (X=False | Y=True)"; graph input

code_block = CodeBlock { ","; }
family_and_type_selector = Custom[Family and Type Selector](VARAllElementsofFamilyNameAlltypes=n02_all_elements_of_family_name, VARFamilyName=n01_family_names_separate_by, VARSpecificTypeNamesSeparatebySymbol=n03_specific_type_names_separate, VARSeparationSymbol=code_block, VAROnlyInActiveView=n04_elements_in_active_view_only)  # package Synthesize toolkit; Family and Type Selector
parameters_selector = Custom[Parameters Selector](VARElements=family_and_type_selector.VARElements, VARParameterNames=n06_name_of_parameters_to_attract, VARSeparationSymbol=code_block)  # package Synthesize toolkit; Parameters Selector
k_attractor_for_parameters = Custom[K-Attractor For Parameters](VARElementstoWorkon=family_and_type_selector.VARElements, VARAttractors=n05_select_attractors, VARRepeatedSequenceforAllParameters=n10_repeated_sequence_for_all, VARReverseNumbers=n09_reverse_numbers, VARStartNumber=n07_start_number, VARSequenceSteps=n08_sequence_steps, VARNormalize=normalize, VARNewMinimumNormalize=n12_new_minimum_normalize_true, VARNewMaximumNormalize=n13_new_maximum_normalize_true, VARProceed=n21_proceed, VARRounding=rounding, VARAdditive=n15_additive, VARListofParameterstoAttract=parameters_selector)  # package Synthesize toolkit; K-Attractor By Selection

# group: Report
n01_values_generated = Watch(k_attractor_for_parameters.VARValuesGenerated)  # "01.Values Generated"; graph output
n02_number_of_unique_elements = Watch(k_attractor_for_parameters.VARNumberofUniqueElements)  # "02.Number of Unique Elements"; graph output
n03_number_of_repeated_elements = Watch(k_attractor_for_parameters.VARNumberofRepeatedElements)  # "03.Number of Repeated Elements"; graph output
n04_number_of_total_elements = Watch(k_attractor_for_parameters.VARNumberofTotalElements)  # "04.Number of Total Elements"; graph output
n05_elements_to_select = Watch(k_attractor_for_parameters.VARElementstoselect)  # "05.Elements to select"; graph output

k_attractor_circles_preview = Custom[K-Attractor Circles Preview](VARCirclePreview=n16_circle_preview_will_draw, VARLocations=k_attractor_for_parameters.VARLocations, VARValuesGenerated=k_attractor_for_parameters.VARValuesGenerated, VARMinimumPreviewCircleRadius=n17_minimum_preview_circle_radius, VARMaximumPreviewCircleRadius=n18_maximum_preview_circle_radius, VARCirclesPreviewDegree=n19_circles_perview_degree, VARCirclesPreviewPlaneX=n20_circles_preview_plane_x_false)  # package Synthesize toolkit; Preview Node for K-Attractor
debug_python = Custom[Debug Python]()  # package Synthesize toolkit; Debug Python
