# Dynamo graph Parameter.K-Attractor By Range with Family and Type.dyn (Dynamo 2.13.1.3887)
# author: karam@aecedx.com
# packages: Synthesize toolkit 12.5.1

# group: Input
n02_all_elements_of_family_name = BoolSelector(true)  # "02.All Elements of Family Name (All types) ?"; graph input
n01_family_names_separate_by = StringInput("Family")  # "01.Family Names (Separate By Comma , - or * To Select All Matching)"; graph input
n03_specific_type_names_separate = StringInput("Type")  # "03.Specific Type Names (Separate by Comma , )"; graph input
n04_elements_in_active_view_only = BoolSelector(false)  # "04.Elements In Active View Only ?"; graph input
n05_select_solids_of_range = DSModelElementsSelection()  # "05.Select Solids of Range"; nothing selected; graph input
n06_select_attractors = DSModelElementsSelection()  # "06.Select Attractors"; nothing selected; graph input
n11_repeated_sequence_for_all = BoolSelector(true)  # "11.Repeated Sequence for All Parameters ?"; graph input
n10_reverse_numbers = BoolSelector(false)  # "10.Reverse Numbers ?"; graph input
n08_start_number = DoubleInput(1)  # "08.Start Number"; graph input
n09_sequence_steps = DoubleInput(0.1)  # "09.Sequence Steps"; graph input
normalize = BoolSelector(false)  # "12.Normalize"; graph input
n13_new_minimum_normalize_true = DoubleInput(0)  # "13.New Minimum (Normalize = True)"; graph input
n14_new_maximum_normalize_true = DoubleInput(1)  # "14.New Maximum (Normalize = True)"; graph input
n22_proceed = BoolSelector(false)  # "22.Proceed ?"; graph input
rounding = DoubleInput(0.01)  # "15.Rounding"; graph input
n16_additive = BoolSelector(false)  # "16.Additive ?"; graph input
n07_name_of_parameters_to_attract = StringInput("Height")  # "07.Name of Parameters to Attract (Separate By Comma , - or * To Select All Matching)"; graph input
n17_circle_preview_will_draw = BoolSelector(false)  # "17.Circle Preview (Will Draw Indicative Circles)"; graph input
n18_minimum_preview_circle_radius = DoubleInput(1)  # "18.Minimum Preview Circle Radius"; graph input
n19_maximum_preview_circle_radius = DoubleInput(5)  # "19.Maximum Preview Circle Radius"; graph input
n20_circles_perview_degree = DoubleInput(0)  # "20.Circles Perview Degree"; graph input
n21_circles_preview_plane_x_false = BoolSelector(false)  # "21.Circles Preview Plane (X=False | Y=True)"; graph input

code_block = CodeBlock { ","; }
family_and_type_selector = Custom[Family and Type Selector](VARAllElementsofFamilyNameAlltypes=n02_all_elements_of_family_name, VARFamilyName=n01_family_names_separate_by, VARSpecificTypeNamesSeparatebySymbol=n03_specific_type_names_separate, VARSeparationSymbol=code_block, VAROnlyInActiveView=n04_elements_in_active_view_only)  # package Synthesize toolkit; Family and Type Selector
location_of_any_element = Custom[Location Of Any Element](VARElements=family_and_type_selector.VARElements)  # package Synthesize toolkit; Location Of Any Element
geometry = Element.Geometry(element=n05_select_solids_of_range)
count = List.Count(list=geometry)
cycle = List.Cycle(list=location_of_any_element.VARElements, amount=count)
count_2 = List.Count(list=location_of_any_element.VARElements)
chop = List.Chop(list=cycle, lengths=count_2)
doesIntersect = Geometry.DoesIntersect(geometry=geometry@L1, other=location_of_any_element.VARLocations)
filterByBoolMask = List.FilterByBoolMask(list=chop, mask=doesIntersect)
code_block_2 = CodeBlock { false; }
clean = List.Clean(list=filterByBoolMask.in, preserveIndices=code_block_2)
flatten = List.Flatten(list=clean)
parameters_selector = Custom[Parameters Selector](VARElements=family_and_type_selector.VARElements, VARParameterNames=n07_name_of_parameters_to_attract, VARSeparationSymbol=code_block)  # package Synthesize toolkit; Parameters Selector
k_attractor_for_parameters = Custom[K-Attractor For Parameters](VARElementstoWorkon=flatten, VARAttractors=n06_select_attractors, VARRepeatedSequenceforAllParameters=n11_repeated_sequence_for_all, VARReverseNumbers=n10_reverse_numbers, VARStartNumber=n08_start_number, VARSequenceSteps=n09_sequence_steps, VARNormalize=normalize, VARNewMinimumNormalize=n13_new_minimum_normalize_true, VARNewMaximumNormalize=n14_new_maximum_normalize_true, VARProceed=n22_proceed, VARRounding=rounding, VARAdditive=n16_additive, VARListofParameterstoAttract=parameters_selector)  # package Synthesize toolkit; K-Attractor By Selection

# group: Report
n01_values_generated = Watch(k_attractor_for_parameters.VARValuesGenerated)  # "01.Values Generated"; graph output
n02_number_of_unique_elements = Watch(k_attractor_for_parameters.VARNumberofUniqueElements)  # "02.Number of Unique Elements"; graph output
n03_number_of_repeated_elements = Watch(k_attractor_for_parameters.VARNumberofRepeatedElements)  # "03.Number of Repeated Elements"; graph output
n04_number_of_total_elements = Watch(k_attractor_for_parameters.VARNumberofTotalElements)  # "04.Number of Total Elements"; graph output
n05_elements_to_select = Watch(k_attractor_for_parameters.VARElementstoselect)  # "05.Elements to select"; graph output

k_attractor_circles_preview = Custom[K-Attractor Circles Preview](VARCirclePreview=n17_circle_preview_will_draw, VARLocations=k_attractor_for_parameters.VARLocations, VARValuesGenerated=k_attractor_for_parameters.VARValuesGenerated, VARMinimumPreviewCircleRadius=n18_minimum_preview_circle_radius, VARMaximumPreviewCircleRadius=n19_maximum_preview_circle_radius, VARCirclesPreviewDegree=n20_circles_perview_degree, VARCirclesPreviewPlaneX=n21_circles_preview_plane_x_false)  # package Synthesize toolkit; Preview Node for K-Attractor
debug_python = Custom[Debug Python]()  # package Synthesize toolkit; Debug Python
