# Dynamo graph Parameter.K-Attractor By Selection Filter.dyn (Dynamo 2.13.1.3887)
# author: karam@aecedx.com
# packages: Synthesize toolkit 12.5.1

hot_get_all_filter = Custom[HOT.Get All Filter]()  # package Synthesize toolkit; Get all Filter
toLower = String.ToLower(string=hot_get_all_filter.VARName)
trimWhitespace = String.TrimWhitespace(string=toLower)

# group: Input
n01_selection_filter_to_read = StringInput("Fitler Name")  # "01.Selection Filter to Read"; graph input
n02_select_attractors = DSModelElementsSelection()  # "02.Select Attractors"; nothing selected; graph input
n07_repeated_sequence_for_all = BoolSelector(true)  # "07.Repeated Sequence for All Parameters ?"; graph input
n06_reverse_numbers = BoolSelector(false)  # "06.Reverse Numbers ?"; graph input
n04_start_number = DoubleInput(1)  # "04.Start Number"; graph input
n05_sequence_steps = DoubleInput(0.1)  # "05.Sequence Steps"; graph input
normalize = BoolSelector(false)  # "08.Normalize"; graph input
n09_new_minimum_normalize_true = DoubleInput(0)  # "09.New Minimum (Normalize = True)"; graph input
n10_new_maximum_normalize_true = DoubleInput(1)  # "10.New Maximum (Normalize = True)"; graph input
n18_proceed = BoolSelector(false)  # "18.Proceed ?"; graph input
rounding = DoubleInput(0.01)  # "11.Rounding"; graph input
n12_additive = BoolSelector(false)  # "12.Additive ?"; graph input
n03_name_of_parameters_to_attract = StringInput("Height")  # "03.Name of Parameters to Attract (Separate By Comma , - or * To Select All Matching)"; graph input
n13_circle_preview_will_draw = BoolSelector(false)  # "13.Circle Preview (Will Draw Indicative Circles)"; graph input
n14_minimum_preview_circle_radius = DoubleInput(1)  # "14.Minimum Preview Circle Radius"; graph input
n15_maximum_preview_circle_radius = DoubleInput(5)  # "15.Maximum Preview Circle Radius"; graph input
n16_circles_perview_degree = DoubleInput(0)  # "16.Circles Perview Degree"; graph input
n17_circles_preview_plane_x_false = BoolSelector(false)  # "17.Circles Preview Plane (X=False | Y=True)"; graph input

toLower_2 = String.ToLower(string=n01_selection_filter_to_read)
trimWhitespace_2 = String.TrimWhitespace(string=toLower_2)
eq = trimWhitespace == trimWhitespace_2
filterByBoolMask = List.FilterByBoolMask(list=hot_get_all_filter.VARElement, mask=eq)
elements = Custom[CW.SelectionSet.Elements](VARselectionSet=filterByBoolMask.in)  # package Synthesize toolkit; Retrieves all elements stored in a selection set
flatten = List.Flatten(list=elements)
code_block = CodeBlock { ","; }
parameters_selector = Custom[Parameters Selector](VARElements=flatten, VARParameterNames=n03_name_of_parameters_to_attract, VARSeparationSymbol=code_block)  # package Synthesize toolkit; Parameters Selector
k_attractor_for_parameters = Custom[K-Attractor For Parameters](VARElementstoWorkon=flatten, VARAttractors=n02_select_attractors, VARRepeatedSequenceforAllParameters=n07_repeated_sequence_for_all, VARReverseNumbers=n06_reverse_numbers, VARStartNumber=n04_start_number, VARSequenceSteps=n05_sequence_steps, VARNormalize=normalize, VARNewMinimumNormalize=n09_new_minimum_normalize_true, VARNewMaximumNormalize=n10_new_maximum_normalize_true, VARProceed=n18_proceed, VARRounding=rounding, VARAdditive=n12_additive, VARListofParameterstoAttract=parameters_selector)  # package Synthesize toolkit; K-Attractor By Selection

# group: Report
n01_values_generated = Watch(k_attractor_for_parameters.VARValuesGenerated)  # "01.Values Generated"; graph output
n02_number_of_unique_elements = Watch(k_attractor_for_parameters.VARNumberofUniqueElements)  # "02.Number of Unique Elements"; graph output
n03_number_of_repeated_elements = Watch(k_attractor_for_parameters.VARNumberofRepeatedElements)  # "03.Number of Repeated Elements"; graph output
n04_number_of_total_elements = Watch(k_attractor_for_parameters.VARNumberofTotalElements)  # "04.Number of Total Elements"; graph output
n05_elements_to_select = Watch(k_attractor_for_parameters.VARElementstoselect)  # "05.Elements to select"; graph output

k_attractor_circles_preview = Custom[K-Attractor Circles Preview](VARCirclePreview=n13_circle_preview_will_draw, VARLocations=k_attractor_for_parameters.VARLocations, VARValuesGenerated=k_attractor_for_parameters.VARValuesGenerated, VARMinimumPreviewCircleRadius=n14_minimum_preview_circle_radius, VARMaximumPreviewCircleRadius=n15_maximum_preview_circle_radius, VARCirclesPreviewDegree=n16_circles_perview_degree, VARCirclesPreviewPlaneX=n17_circles_preview_plane_x_false)  # package Synthesize toolkit; Preview Node for K-Attractor
debug_python = Custom[Debug Python]()  # package Synthesize toolkit; Debug Python
