# Dynamo graph Parameter.K-Attractor Material By All Elements of Active View.dyn (Dynamo 2.13.1.3887)
# author: karam@aecedx.com
# packages: Synthesize toolkit 12.5.1

# group: Input
n01_select_attractors = DSModelElementsSelection()  # "01.Select Attractors"; nothing selected; graph input
n07_reverse_materials = BoolSelector(false)  # "07.Reverse Materials ?"; graph input
n05_balanced_rhythm_seed = BoolSelector(true)  # "05.Balanced Rhythm (Seed) ?"; graph input
n06_custom_seed_value = DoubleInput(0)  # "06.Custom Seed Value"; graph input
n08_proceed = BoolSelector(false)  # "08.Proceed ?"; graph input
n02_materials_to_attract_seperate = StringInput("Cherry, Glass, Aluminum")  # "02.Materials to Attract (Seperate by Symbol)"; graph input
n03_separation_symbol = StringInput(",")  # "03.Separation Symbol"; graph input
n04_name_of_material_parameters = StringInput("Material")  # "04.Name of Material Parameters to Attract (Separate By Comma , or - * To Select All Matching)"; graph input

python_all_elements_in_active = Custom[Python All Elements In Active View]()  # package Synthesize toolkit; Python All Elements In Active View
python_all_elements_in_active_2 = Custom[Python All Elements In Active View]()
removeListFromList = Custom[RH.RemoveListFromList](VARListA=python_all_elements_in_active_2, VARListB=n01_select_attractors)  # package Synthesize toolkit; This node essentially "subtracts" the contents of List B from List A to produce a new list with the unique items.
code_block = CodeBlock { ","; }
parameters_selector = Custom[Parameters Selector](VARElements=removeListFromList, VARParameterNames=n04_name_of_material_parameters, VARSeparationSymbol=code_block)  # package Synthesize toolkit; Parameters Selector
k_attractor_for_materials = Custom[K-Attractor For Materials](VARAttractors=n01_select_attractors, VARReverseMaterials=n07_reverse_materials, VARBalancedRhythmSeed=n05_balanced_rhythm_seed, VARCustomSeedValue=n06_custom_seed_value, VARProceed=n08_proceed, VARAllElementsInActiveView=python_all_elements_in_active, VARElementstoWorkon=removeListFromList, VARMaterialstoAttract=n02_materials_to_attract_seperate, VARSeperationSymbol=n03_separation_symbol, VARMaterialParameters=parameters_selector)  # package Synthesize toolkit; K-Attractor For Family Types
name = Material.Name(material=k_attractor_for_materials.VARMaterialsOrdertoUse)

# group: Result
n01_balanced_seed_value = Watch(k_attractor_for_materials.VARBalancedSeedValue)  # "01.Balanced Seed Value"; graph output
n02_number_of_total_elements = Watch(k_attractor_for_materials.VARNumberofTotalElements)  # "02.Number of Total Elements"; graph output
n03_materials_order_to_use = Watch(name)  # "03.Materials Order to Use"; graph output
n04_elements_to_select = Watch(k_attractor_for_materials.VARElementstoselect)  # "04.Elements to select"; graph output

debug_python = Custom[Debug Python]()  # package Synthesize toolkit; Debug Python
