# Dynamo graph Parameter.K-Attractor Material By Family and Type.dyn (Dynamo 2.13.1.3887)
# author: karam@aecedx.com
# packages: Synthesize toolkit 12.5.1

# group: Input
n05_select_attractors = DSModelElementsSelection()  # "05.Select Attractors"; nothing selected; graph input
n11_reverse_materials = BoolSelector(false)  # "11.Reverse Materials ?"; graph input
n09_balanced_rhythm_seed = BoolSelector(true)  # "09.Balanced Rhythm (Seed) ?"; graph input
n10_custom_seed_value = DoubleInput(0)  # "10.Custom Seed Value"; graph input
n12_proceed = BoolSelector(false)  # "12.Proceed ?"; graph input
n02_all_elements_of_family_name = BoolSelector(true)  # "02.All Elements of Family Name (All types) ?"; graph input
n01_family_names_separate_by = StringInput("Family")  # "01.Family Names (Separate By Comma , - or * To Select All Matching)"; graph input
n03_specific_type_names_separate = StringInput("Type")  # "03.Specific Type Names (Separate by Comma , )"; graph input
n04_elements_in_active_view_only = BoolSelector(false)  # "04.Elements In Active View Only ?"; graph input
n06_materials_to_attract_seperate = StringInput("Cherry, Glass, Aluminum")  # "06.Materials to Attract (Seperate by Symbol)"; graph input
n07_separation_symbol = StringInput(",")  # "07.Separation Symbol"; graph input
n08_name_of_material_parameters = StringInput("Material")  # "08.Name of Material Parameters to Attract (Separate By Comma , or - * To Select All Matching)"; graph input

python_all_elements_in_active = Custom[Python All Elements In Active View]()  # package Synthesize toolkit; Python All Elements In Active View
code_block = CodeBlock { ","; }
family_and_type_selector = Custom[Family and Type Selector](VARAllElementsofFamilyNameAlltypes=n02_all_elements_of_family_name, VARFamilyName=n01_family_names_separate_by, VARSpecificTypeNamesSeparatebySymbol=n03_specific_type_names_separate, VARSeparationSymbol=code_block, VAROnlyInActiveView=n04_elements_in_active_view_only)  # package Synthesize toolkit; Family and Type Selector
parameters_selector = Custom[Parameters Selector](VARElements=family_and_type_selector.VARElements, VARParameterNames=n08_name_of_material_parameters, VARSeparationSymbol=code_block)  # package Synthesize toolkit; Parameters Selector
k_attractor_for_materials = Custom[K-Attractor For Materials](VARAttractors=n05_select_attractors, VARReverseMaterials=n11_reverse_materials, VARBalancedRhythmSeed=n09_balanced_rhythm_seed, VARCustomSeedValue=n10_custom_seed_value, VARProceed=n12_proceed, VARAllElementsInActiveView=python_all_elements_in_active, VARElementstoWorkon=family_and_type_selector.VARElements, VARMaterialstoAttract=n06_materials_to_attract_seperate, VARSeperationSymbol=n07_separation_symbol, VARMaterialParameters=parameters_selector)  # package Synthesize toolkit; K-Attractor For Family Types
name = Material.Name(material=k_attractor_for_materials.VARMaterialsOrdertoUse)

# group: Result
n01_balanced_seed_value = Watch(k_attractor_for_materials.VARBalancedSeedValue)  # "01.Balanced Seed Value"; graph output
n02_number_of_total_elements = Watch(k_attractor_for_materials.VARNumberofTotalElements)  # "02.Number of Total Elements"; graph output
n03_materials_order_to_use = Watch(name)  # "03.Materials Order to Use"; graph output
n04_elements_to_select = Watch(k_attractor_for_materials.VARElementstoselect)  # "04.Elements to select"; graph output

debug_python = Custom[Debug Python]()  # package Synthesize toolkit; Debug Python
