# Dynamo graph Parameter.K-Attractor Material By Range with Family and Type.dyn (Dynamo 2.13.1.3887)
# author: karam@aecedx.com
# packages: Synthesize toolkit 12.5.1

# group: Input
n06_select_attractors = DSModelElementsSelection()  # "06.Select Attractors"; nothing selected; graph input
n12_reverse_materials = BoolSelector(false)  # "12.Reverse Materials ?"; graph input
n10_balanced_rhythm_seed = BoolSelector(true)  # "10.Balanced Rhythm (Seed) ?"; graph input
n11_custom_seed_value = DoubleInput(0)  # "11.Custom Seed Value"; graph input
n13_proceed = BoolSelector(false)  # "13.Proceed ?"; graph input
n02_all_elements_of_family_name = BoolSelector(true)  # "02.All Elements of Family Name (All types) ?"; graph input
n01_family_names_separate_by = StringInput("Family")  # "01.Family Names (Separate By Comma , - or * To Select All Matching)"; graph input
n03_specific_type_names_separate = StringInput("Type")  # "03.Specific Type Names (Separate by Comma , )"; graph input
n04_elements_in_active_view_only = BoolSelector(false)  # "04.Elements In Active View Only ?"; graph input
n05_select_solids_of_range = DSModelElementsSelection()  # "05.Select Solids of Range"; nothing selected; graph input
n07_materials_to_attract_seperate = StringInput("Cherry, Glass, Aluminum")  # "07.Materials to Attract (Seperate by Symbol)"; graph input
n08_separation_symbol = StringInput(",")  # "08.Separation Symbol"; graph input
n09_name_of_material_parameters = StringInput("Material")  # "09.Name of Material Parameters to Attract (Separate By Comma , or - * To Select All Matching)"; graph input

python_all_elements_in_active = Custom[Python All Elements In Active View]()  # package Synthesize toolkit; Python All Elements In Active View
code_block = CodeBlock { ","; }
family_and_type_selector = Custom[Family and Type Selector](VARAllElementsofFamilyNameAlltypes=n02_all_elements_of_family_name, VARFamilyName=n01_family_names_separate_by, VARSpecificTypeNamesSeparatebySymbol=n03_specific_type_names_separate, VARSeparationSymbol=code_block, VAROnlyInActiveView=n04_elements_in_active_view_only)  # package Synthesize toolkit; Family and Type Selector
location_of_any_element = Custom[Location Of Any Element](VARElements=family_and_type_selector.VARElements)  # package Synthesize toolkit; Location Of Any Element
geometry = Element.Geometry(element=n05_select_solids_of_range)
count = List.Count(list=geometry)
cycle = List.Cycle(list=location_of_any_element.VARElements, amount=count)
count_2 = List.Count(list=location_of_any_element.VARElements)
chop = List.Chop(list=cycle, lengths=count_2)
doesIntersect = Geometry.DoesIntersect(geometry=geometry@L1, other=location_of_any_element.VARLocations)
filterByBoolMask = List.FilterByBoolMask(list=chop, mask=doesIntersect)
code_block_2 = CodeBlock { false; }
clean = List.Clean(list=filterByBoolMask.in, preserveIndices=code_block_2)
flatten = List.Flatten(list=clean)
parameters_selector = Custom[Parameters Selector](VARElements=family_and_type_selector.VARElements, VARParameterNames=n09_name_of_material_parameters, VARSeparationSymbol=code_block)  # package Synthesize toolkit; Parameters Selector
k_attractor_for_materials = Custom[K-Attractor For Materials](VARAttractors=n06_select_attractors, VARReverseMaterials=n12_reverse_materials, VARBalancedRhythmSeed=n10_balanced_rhythm_seed, VARCustomSeedValue=n11_custom_seed_value, VARProceed=n13_proceed, VARAllElementsInActiveView=python_all_elements_in_active, VARElementstoWorkon=flatten, VARMaterialstoAttract=n07_materials_to_attract_seperate, VARSeperationSymbol=n08_separation_symbol, VARMaterialParameters=parameters_selector)  # package Synthesize toolkit; K-Attractor For Family Types
name = Material.Name(material=k_attractor_for_materials.VARMaterialsOrdertoUse)

# group: Result
n01_balanced_seed_value = Watch(k_attractor_for_materials.VARBalancedSeedValue)  # "01.Balanced Seed Value"; graph output
n02_number_of_total_elements = Watch(k_attractor_for_materials.VARNumberofTotalElements)  # "02.Number of Total Elements"; graph output
n03_materials_order_to_use = Watch(name)  # "03.Materials Order to Use"; graph output
n04_elements_to_select = Watch(k_attractor_for_materials.VARElementstoselect)  # "04.Elements to select"; graph output

debug_python = Custom[Debug Python]()  # package Synthesize toolkit; Debug Python
