# Dynamo graph Parameter.K-Attractor Material By Selection.dyn (Dynamo 2.13.1.3887)
# author: karam@aecedx.com
# packages: Synthesize toolkit 12.5.1

# group: Input
n02_select_attractors = DSModelElementsSelection()  # "02.Select Attractors"; nothing selected; graph input
n08_reverse_materials = BoolSelector(false)  # "08.Reverse Materials ?"; graph input
n06_balanced_rhythm_seed = BoolSelector(true)  # "06.Balanced Rhythm (Seed) ?"; graph input
n07_custom_seed_value = DoubleInput(0)  # "07.Custom Seed Value"; graph input
n09_proceed = BoolSelector(false)  # "09.Proceed ?"; graph input
n01_select_elements_to_attract = DSModelElementsSelection()  # "01.Select Elements to Attract"; nothing selected; graph input
n03_materials_to_attract_seperate = StringInput("Cherry, Glass, Aluminum")  # "03.Materials to Attract (Seperate by Symbol)"; graph input
n04_separation_symbol = StringInput(",")  # "04.Separation Symbol"; graph input
n05_name_of_material_parameters = StringInput("Material")  # "05.Name of Material Parameters to Attract (Separate By Comma , or - * To Select All Matching)"; graph input

python_all_elements_in_active = Custom[Python All Elements In Active View]()  # package Synthesize toolkit; Python All Elements In Active View
code_block = CodeBlock { ","; }
parameters_selector = Custom[Parameters Selector](VARElements=n01_select_elements_to_attract, VARParameterNames=n05_name_of_material_parameters, VARSeparationSymbol=code_block)  # package Synthesize toolkit; Parameters Selector
k_attractor_for_materials = Custom[K-Attractor For Materials](VARAttractors=n02_select_attractors, VARReverseMaterials=n08_reverse_materials, VARBalancedRhythmSeed=n06_balanced_rhythm_seed, VARCustomSeedValue=n07_custom_seed_value, VARProceed=n09_proceed, VARAllElementsInActiveView=python_all_elements_in_active, VARElementstoWorkon=n01_select_elements_to_attract, VARMaterialstoAttract=n03_materials_to_attract_seperate, VARSeperationSymbol=n04_separation_symbol, VARMaterialParameters=parameters_selector)  # package Synthesize toolkit; K-Attractor For Family Types
name = Material.Name(material=k_attractor_for_materials.VARMaterialsOrdertoUse)

# group: Result
n01_balanced_seed_value = Watch(k_attractor_for_materials.VARBalancedSeedValue)  # "01.Balanced Seed Value"; graph output
n02_number_of_total_elements = Watch(k_attractor_for_materials.VARNumberofTotalElements)  # "02.Number of Total Elements"; graph output
n03_materials_order_to_use = Watch(name)  # "03.Materials Order to Use"; graph output
n04_elements_to_select = Watch(k_attractor_for_materials.VARElementstoselect)  # "04.Elements to select"; graph output

debug_python = Custom[Debug Python]()  # package Synthesize toolkit; Debug Python
