# Dynamo graph Parameter.K-Change By Selection Filter.dyn (Dynamo 2.13.1.3887)
# author: karam@aecedx.com
# packages: Synthesize toolkit 12.5.1

# group: Input
n04_parameter_s_value_to_set_text = StringInput("Karam")  # "04.Parameter(s) Value To Set (Text, Number, Material, Level...etc) - Separate By Symbol"; graph input
n05_separation_symbol = StringInput(",")  # "05.Separation Symbol"; graph input
n02_parameter_s_to_change_text = StringInput("Comments")  # "02.Parameter(s) To Change (Text, Number, Material, Level...etc) - Separate By Symbol - * To Select All Matching"; graph input
n03_is_type_parameter_s = BoolSelector(false)  # "03.Is Type Parameter(s)"; graph input
n01_selection_filter_to_read = StringInput("Filter Name")  # "01.Selection Filter to Read"; graph input
n06_fetch_groups_elements_might = BoolSelector(false)  # "06.Fetch Groups Elements (Might Help For Strange Behaviours Like Stairs)"; graph input

split = String.Split(string=n04_parameter_s_value_to_set_text, separator0=n05_separation_symbol)
split_2 = String.Split(string=n02_parameter_s_to_change_text, separator0=n05_separation_symbol)
hot_get_all_filter = Custom[HOT.Get All Filter]()  # package Synthesize toolkit; Get all Filter
toLower = String.ToLower(string=hot_get_all_filter.VARName)
trimWhitespace = String.TrimWhitespace(string=toLower)
toLower_2 = String.ToLower(string=n01_selection_filter_to_read)
trimWhitespace_2 = String.TrimWhitespace(string=toLower_2)
eq = trimWhitespace == trimWhitespace_2
filterByBoolMask = List.FilterByBoolMask(list=hot_get_all_filter.VARElement, mask=eq)
elements = Custom[CW.SelectionSet.Elements](VARselectionSet=filterByBoolMask.in)  # package Synthesize toolkit; Retrieves all elements stored in a selection set
flatten = List.Flatten(list=elements)
recurring_group_elements_fetch = Custom[Recurring Group Elements Fetch](VARElements=flatten, VARFetch=n06_fetch_groups_elements_might)  # package Synthesize toolkit; Recurring Group Elements Fetch
advanced_elements_filter = Custom[Advanced Elements Filter](VARIsTypeParameter=n03_is_type_parameter_s, VARParametersList=split_2, VARElements=recurring_group_elements_fetch)  # package Synthesize toolkit; Advanced Elements Filter
advanced_parameter_set_with = Custom[Advanced Parameter Set With Translate](VARParameterValueToSet=split@L1, VARParameterToChange=split_2@L1, VARParameters=advanced_elements_filter.VARParameter, VARIsType=n03_is_type_parameter_s, VARElements=advanced_elements_filter.VARElements, VARParameterNames=advanced_elements_filter.VARParameterNames)  # package Synthesize toolkit; Advanced Parameter Set With Translate

# group: Report
n01_number_of_effected_elements = Watch(advanced_parameter_set_with)  # "01.Number of Effected Elements"; graph output

debug_python_no_message = Custom[Debug Python No Message]()  # package Synthesize toolkit; Debug Python
