# Dynamo graph Parameter.Randomize By Family and Type.dyn (Dynamo 2.13.1.3887)
# author: karam@aecedx.com
# packages: Synthesize toolkit 12.5.1

debug_python = Custom[Debug Python]()  # package Synthesize toolkit; Debug Python

# group: Input
n11_additive = BoolSelector(false)  # "11.Additive ?"; graph input
rounding = DoubleInput(0.01)  # "10.Rounding"; graph input
n12_proceed = BoolSelector(false)  # "12.Proceed ?"; graph input
n09_integer_numbers_of = BoolSelector(false)  # "09.Integer numbers of Randomizing ?"; graph input
n07_minimum_value = DoubleInput(5)  # "07.Minimum Value"; graph input
n08_maximum_value = DoubleInput(12)  # "08.Maximum Value"; graph input
n02_all_elements_of_family_name = BoolSelector(true)  # "02.All Elements of Family Name (All types) ?"; graph input
n01_family_names_separate_by = StringInput("Family")  # "01.Family Names (Separate By Comma , - or * To Select All Matching)"; graph input
n03_specific_type_names_separate = StringInput("Type")  # "03.Specific Type Names (Separate by Comma , )"; graph input
n04_elements_in_active_view_only = BoolSelector(false)  # "04.Elements In Active View Only ?"; graph input
n06_name_of_parameters_to = StringInput("Height")  # "06.Name of Parameters to Randomize (Separate By Comma , or - * To Select All Matching)"; graph input
n05_is_type_parameter = BoolSelector(false)  # "05.Is Type Parameter ?"; graph input

code_block = CodeBlock { ","; }
family_and_type_selector = Custom[Family and Type Selector](VARAllElementsofFamilyNameAlltypes=n02_all_elements_of_family_name, VARFamilyName=n01_family_names_separate_by, VARSpecificTypeNamesSeparatebySymbol=n03_specific_type_names_separate, VARSeparationSymbol=code_block, VAROnlyInActiveView=n04_elements_in_active_view_only)  # package Synthesize toolkit; Family and Type Selector
parameters_selector = Custom[Parameters Selector](VARElements=family_and_type_selector.VARElements, VARParameterNames=n06_name_of_parameters_to, VARSeparationSymbol=code_block, VARIsTypeParam=n05_is_type_parameter)  # package Synthesize toolkit; Parameters Selector
randomize_parameters = Custom[Randomize Parameters](VARAdditive=n11_additive, VARRounding=rounding, VARProceed=n12_proceed, VARIntegernumbersofRandomizing=n09_integer_numbers_of, VARMinimumValue=n07_minimum_value, VARMaximumValue=n08_maximum_value, VARListofParameterstoRandomize=parameters_selector, VARElementstoWorkon=family_and_type_selector.VARElements, VARIsTypeParameters=n05_is_type_parameter)  # package Synthesize toolkit; Randomize Parameters

# group: Report
n02_values_generated = Watch(randomize_parameters)  # "02.Values Generated"; graph output

count = List.Count(list=n02_values_generated)

# group (continued): Report
n01_number_of_elements = Watch(count)  # "01.Number of Elements"; graph output
