# Dynamo graph Parameter.Randomize By Range with Family and Type.dyn (Dynamo 2.13.1.3887)
# author: karam@aecedx.com
# packages: Synthesize toolkit 12.5.1

# group: Input
n12_additive = BoolSelector(false)  # "12.Additive ?"; graph input
rounding = DoubleInput(0.01)  # "11.Rounding"; graph input
n13_proceed = BoolSelector(false)  # "13.Proceed ?"; graph input
n10_integer_numbers_of = BoolSelector(false)  # "10.Integer numbers of Randomizing ?"; graph input
n08_minimum_value = DoubleInput(5)  # "08.Minimum Value"; graph input
n09_maximum_value = DoubleInput(12)  # "09.Maximum Value"; graph input
n02_all_elements_of_family_name = BoolSelector(true)  # "02.All Elements of Family Name (All types) ?"; graph input
n01_family_names_separate_by = StringInput("Family")  # "01.Family Names (Separate By Comma , - or * To Select All Matching)"; graph input
n03_specific_type_names_separate = StringInput("Type")  # "03.Specific Type Names (Separate by Comma , )"; graph input
n04_elements_in_active_view_only = BoolSelector(false)  # "04.Elements In Active View Only ?"; graph input
n07_name_of_parameters_to = StringInput("Height")  # "07.Name of Parameters to Randomize (Separate By Comma , or - * To Select All Matching)"; graph input
n06_is_type_parameter = BoolSelector(false)  # "06.Is Type Parameter ?"; graph input
n05_select_solids_of_range = DSModelElementsSelection()  # "05.Select Solids of Range"; nothing selected; graph input

code_block = CodeBlock { ","; }
family_and_type_selector = Custom[Family and Type Selector](VARAllElementsofFamilyNameAlltypes=n02_all_elements_of_family_name, VARFamilyName=n01_family_names_separate_by, VARSpecificTypeNamesSeparatebySymbol=n03_specific_type_names_separate, VARSeparationSymbol=code_block, VAROnlyInActiveView=n04_elements_in_active_view_only)  # package Synthesize toolkit; Family and Type Selector
parameters_selector = Custom[Parameters Selector](VARElements=family_and_type_selector.VARElements, VARParameterNames=n07_name_of_parameters_to, VARSeparationSymbol=code_block, VARIsTypeParam=n06_is_type_parameter)  # package Synthesize toolkit; Parameters Selector
location_of_any_element = Custom[Location Of Any Element](VARElements=family_and_type_selector.VARElements)  # package Synthesize toolkit; Location Of Any Element
geometry = Element.Geometry(element=n05_select_solids_of_range)
count = List.Count(list=geometry)
cycle = List.Cycle(list=location_of_any_element.VARElements, amount=count)
count_2 = List.Count(list=location_of_any_element.VARElements)
chop = List.Chop(list=cycle, lengths=count_2)
doesIntersect = Geometry.DoesIntersect(geometry=geometry@L1, other=location_of_any_element.VARLocations)
filterByBoolMask = List.FilterByBoolMask(list=chop, mask=doesIntersect)
code_block_2 = CodeBlock { false; }
clean = List.Clean(list=filterByBoolMask.in, preserveIndices=code_block_2)
flatten = List.Flatten(list=clean)
randomize_parameters = Custom[Randomize Parameters](VARAdditive=n12_additive, VARRounding=rounding, VARProceed=n13_proceed, VARIntegernumbersofRandomizing=n10_integer_numbers_of, VARMinimumValue=n08_minimum_value, VARMaximumValue=n09_maximum_value, VARListofParameterstoRandomize=parameters_selector, VARElementstoWorkon=flatten, VARIsTypeParameters=n06_is_type_parameter)  # package Synthesize toolkit; Randomize Parameters

# group: Report
n02_values_generated = Watch(randomize_parameters)  # "02.Values Generated"; graph output

count_3 = List.Count(list=n02_values_generated)

# group (continued): Report
n01_number_of_elements = Watch(count_3)  # "01.Number of Elements"; graph output

debug_python = Custom[Debug Python]()  # package Synthesize toolkit; Debug Python
