# Dynamo graph Parameter.Randomize By Selection Filter.dyn (Dynamo 2.13.1.3887)
# author: karam@aecedx.com
# packages: Synthesize toolkit 12.5.1

# group: Input
n08_additive = BoolSelector(false)  # "08.Additive ?"; graph input
rounding = DoubleInput(0.01)  # "07.Rounding"; graph input
n09_proceed = BoolSelector(false)  # "09.Proceed ?"; graph input
n06_integer_numbers_of = BoolSelector(false)  # "06.Integer numbers of Randomizing ?"; graph input
n04_minimum_value = DoubleInput(5)  # "04.Minimum Value"; graph input
n05_maximum_value = DoubleInput(12)  # "05.Maximum Value"; graph input
n01_selection_filter_to_read = StringInput("Fitler Name")  # "01.Selection Filter to Read"; graph input
n03_name_of_parameters_to = StringInput("Height")  # "03.Name of Parameters to Randomize (Separate By Comma , or - * To Select All Matching)"; graph input
n02_is_type_parameter = BoolSelector(false)  # "02.Is Type Parameter ?"; graph input

hot_get_all_filter = Custom[HOT.Get All Filter]()  # package Synthesize toolkit; Get all Filter
toLower = String.ToLower(string=hot_get_all_filter.VARName)
trimWhitespace = String.TrimWhitespace(string=toLower)
toLower_2 = String.ToLower(string=n01_selection_filter_to_read)
trimWhitespace_2 = String.TrimWhitespace(string=toLower_2)
eq = trimWhitespace == trimWhitespace_2
filterByBoolMask = List.FilterByBoolMask(list=hot_get_all_filter.VARElement, mask=eq)
elements = Custom[CW.SelectionSet.Elements](VARselectionSet=filterByBoolMask.in)  # package Synthesize toolkit; Retrieves all elements stored in a selection set
flatten = List.Flatten(list=elements)
code_block = CodeBlock { ","; }
parameters_selector = Custom[Parameters Selector](VARElements=flatten, VARParameterNames=n03_name_of_parameters_to, VARSeparationSymbol=code_block, VARIsTypeParam=n02_is_type_parameter)  # package Synthesize toolkit; Parameters Selector
randomize_parameters = Custom[Randomize Parameters](VARAdditive=n08_additive, VARRounding=rounding, VARProceed=n09_proceed, VARIntegernumbersofRandomizing=n06_integer_numbers_of, VARMinimumValue=n04_minimum_value, VARMaximumValue=n05_maximum_value, VARListofParameterstoRandomize=parameters_selector, VARElementstoWorkon=flatten, VARIsTypeParameters=n02_is_type_parameter)  # package Synthesize toolkit; Randomize Parameters

# group: Report
n02_values_generated = Watch(randomize_parameters)  # "02.Values Generated"; graph output

count = List.Count(list=n02_values_generated)

# group (continued): Report
n01_number_of_elements = Watch(count)  # "01.Number of Elements"; graph output

debug_python = Custom[Debug Python]()  # package Synthesize toolkit; Debug Python
