# Dynamo graph Parameter.Randomize Material By All Elements of Active View.dyn (Dynamo 2.13.1.3887)
# author: karam@aecedx.com
# packages: Synthesize toolkit 12.5.1

python_all_elements_in_active = Custom[Python All Elements In Active View]()  # package Synthesize toolkit; Python All Elements In Active View

# group: Input
n03_is_type_parameter = BoolSelector(false)  # "03.Is Type Parameter ?"; graph input
n01_materials_to_randomize = StringInput("Cherry, Glass, Aluminum")  # "01.Materials to Randomize (Seperate by Symbol)"; graph input
n02_separation_symbol = StringInput(",")  # "02.Separation Symbol"; graph input
n04_name_of_material_parameters = StringInput("Material")  # "04.Name of Material Parameters to Randomize (Separate By Comma , - or * To Select All Matching)"; graph input

code_block = CodeBlock { ","; }
parameters_selector = Custom[Parameters Selector](VARElements=python_all_elements_in_active, VARParameterNames=n04_name_of_material_parameters, VARSeparationSymbol=code_block, VARIsTypeParam=n03_is_type_parameter)  # package Synthesize toolkit; Parameters Selector
randomize_material_parameters = Custom[Randomize Material Parameters](VARElementstoWorkon=python_all_elements_in_active, VARIsTypeParameters=n03_is_type_parameter, VARMaterialstoRandomizeSeperatebySymbol=n01_materials_to_randomize, VARSeparationSymbol=n02_separation_symbol, VARListofParameterstoRandomize=parameters_selector)  # package Synthesize toolkit; Randomize Material Parameters

# group: Report
n01_number_of_elements = Watch(randomize_material_parameters.VARNumberofElements)  # "01.Number of Elements"; graph output
n02_elements_to_select = Watch(randomize_material_parameters.VARElementstoselect)  # "02.Elements to select"; graph output

debug_python = Custom[Debug Python]()  # package Synthesize toolkit; Debug Python
