# Dynamo graph Parameter.Remap By All Elements of Active View.dyn (Dynamo 2.13.1.3887)
# author: karam@aecedx.com
# packages: Synthesize toolkit 12.5.1

# group: Input
n04_proceed = BoolSelector(false)  # "04.Proceed ?"; graph input
n02_name_of_parameters_to_remap = StringInput("Height")  # "02.Name of Parameters to Remap (Separate By Comma , - or * To Select All Matching)"; graph input
n01_is_type_parameter = BoolSelector(false)  # "01.Is Type Parameter ?"; graph input
n03_value_to_add = DoubleInput(5)  # "03.Value to Add"; graph input

python_all_elements_in_active = Custom[Python All Elements In Active View]()  # package Synthesize toolkit; Python All Elements In Active View
code_block = CodeBlock { ","; }
parameters_selector = Custom[Parameters Selector](VARElements=python_all_elements_in_active, VARParameterNames=n02_name_of_parameters_to_remap, VARSeparationSymbol=code_block, VARIsTypeParam=n01_is_type_parameter)  # package Synthesize toolkit; Parameters Selector
remap_parameters = Custom[Remap Parameters](VARProceed=n04_proceed, VARListofParameterstoRemap=parameters_selector, VARElementstoWorkon=python_all_elements_in_active, VARIsTypeParameters=n01_is_type_parameter, VARValuetoAdd=n03_value_to_add)  # package Synthesize toolkit; Randomize Parameters

# group: Report
n01_number_of_elements = Watch(remap_parameters.VARNumberofElements)  # "01.Number of Elements"; graph output
n02_elements_to_select = Watch(remap_parameters.VARElementstoselect)  # "02.Elements to Select"; graph output

debug_python_no_message = Custom[Debug Python No Message]()  # package Synthesize toolkit; Debug Python
