# Dynamo graph Parameter.Remap By Family and Type.dyn (Dynamo 2.13.1.3887)
# author: karam@aecedx.com
# packages: Synthesize toolkit 12.5.1

# group: Input
n08_proceed = BoolSelector(false)  # "08.Proceed ?"; graph input
n02_all_elements_of_family_name = BoolSelector(true)  # "02.All Elements of Family Name (All types) ?"; graph input
n01_family_names_separate_by = StringInput("Family")  # "01.Family Names (Separate By Comma , - or * To Select All Matching)"; graph input
n03_specific_type_names_separate = StringInput("Type")  # "03.Specific Type Names (Separate by Comma , )"; graph input
n04_elements_in_active_view_only = BoolSelector(false)  # "04.Elements In Active View Only ?"; graph input
n06_name_of_parameters_to_remap = StringInput("Height")  # "06.Name of Parameters to Remap (Separate By Comma , - or * To Select All Matching)"; graph input
n05_is_type_parameter = BoolSelector(false)  # "05.Is Type Parameter ?"; graph input
n07_value_to_add = DoubleInput(5)  # "07.Value to Add"; graph input

code_block = CodeBlock { ","; }
family_and_type_selector = Custom[Family and Type Selector](VARAllElementsofFamilyNameAlltypes=n02_all_elements_of_family_name, VARFamilyName=n01_family_names_separate_by, VARSpecificTypeNamesSeparatebySymbol=n03_specific_type_names_separate, VARSeparationSymbol=code_block, VAROnlyInActiveView=n04_elements_in_active_view_only)  # package Synthesize toolkit; Family and Type Selector
code_block_2 = CodeBlock { ","; }
parameters_selector = Custom[Parameters Selector](VARElements=family_and_type_selector.VARElements, VARParameterNames=n06_name_of_parameters_to_remap, VARSeparationSymbol=code_block_2, VARIsTypeParam=n05_is_type_parameter)  # package Synthesize toolkit; Parameters Selector
remap_parameters = Custom[Remap Parameters](VARProceed=n08_proceed, VARListofParameterstoRemap=parameters_selector, VARElementstoWorkon=family_and_type_selector.VARElements, VARIsTypeParameters=n05_is_type_parameter, VARValuetoAdd=n07_value_to_add)  # package Synthesize toolkit; Randomize Parameters

# group: Report
n01_number_of_elements = Watch(remap_parameters.VARNumberofElements)  # "01.Number of Elements"; graph output
n02_elements_to_select = Watch(remap_parameters.VARElementstoselect)  # "02.Elements to select"; graph output

debug_python_no_message = Custom[Debug Python No Message]()  # package Synthesize toolkit; Debug Python
