# Dynamo graph Parameter.Remap By Selection Filter.dyn (Dynamo 2.13.1.3887)
# author: karam@aecedx.com
# packages: Synthesize toolkit 12.5.1

# group: Input
n04_proceed = BoolSelector(false)  # "04.Proceed ?"; graph input
n01_selection_filter_to_read = StringInput("Fitler Name")  # "01.Selection Filter to Read"; graph input
n03_name_of_parameters_to_remap = StringInput("Height")  # "03.Name of Parameters to Remap (Separate By Comma , - or * To Select All Matching)"; graph input
n02_is_type_parameter = BoolSelector(false)  # "02.Is Type Parameter ?"; graph input
n05_value_to_add = DoubleInput(5)  # "05.Value to Add"; graph input

hot_get_all_filter = Custom[HOT.Get All Filter]()  # package Synthesize toolkit; Get all Filter
toLower = String.ToLower(string=hot_get_all_filter.VARName)
trimWhitespace = String.TrimWhitespace(string=toLower)
toLower_2 = String.ToLower(string=n01_selection_filter_to_read)
trimWhitespace_2 = String.TrimWhitespace(string=toLower_2)
eq = trimWhitespace == trimWhitespace_2
filterByBoolMask = List.FilterByBoolMask(list=hot_get_all_filter.VARElement, mask=eq)
elements = Custom[CW.SelectionSet.Elements](VARselectionSet=filterByBoolMask.in)  # package Synthesize toolkit; Retrieves all elements stored in a selection set
flatten = List.Flatten(list=elements)
code_block = CodeBlock { ","; }
parameters_selector = Custom[Parameters Selector](VARElements=flatten, VARParameterNames=n03_name_of_parameters_to_remap, VARSeparationSymbol=code_block, VARIsTypeParam=n02_is_type_parameter)  # package Synthesize toolkit; Parameters Selector
remap_parameters = Custom[Remap Parameters](VARProceed=n04_proceed, VARListofParameterstoRemap=parameters_selector, VARElementstoWorkon=flatten, VARIsTypeParameters=n02_is_type_parameter, VARValuetoAdd=n05_value_to_add)  # package Synthesize toolkit; Randomize Parameters

# group: Report
n01_number_of_elements = Watch(remap_parameters.VARNumberofElements)  # "01.Number of Elements"; graph output
n02_elements_to_select = Watch(remap_parameters.VARElementstoselect)  # "02.Elements to select"; graph output

debug_python_no_message = Custom[Debug Python No Message]()  # package Synthesize toolkit; Debug Python
