# Dynamo graph Parameter.Remap By Selection.dyn (Dynamo 2.13.1.3887)
# author: karam@aecedx.com
# packages: Synthesize toolkit 12.5.1

# group: Input
n05_proceed = BoolSelector(false)  # "05.Proceed ?"; graph input
n01_select_elements_to_work_on = DSModelElementsSelection()  # "01.Select Elements to Work on"; nothing selected; graph input
n03_name_of_parameters_to_remap = StringInput("Height")  # "03.Name of Parameters to Remap (Separate By Comma , - or * To Select All Matching)"; graph input
n02_is_type_parameter = BoolSelector(false)  # "02.Is Type Parameter ?"; graph input
n04_value_to_add = DoubleInput(5)  # "04.Value to Add"; graph input

code_block = CodeBlock { ","; }
parameters_selector = Custom[Parameters Selector](VARElements=n01_select_elements_to_work_on, VARParameterNames=n03_name_of_parameters_to_remap, VARSeparationSymbol=code_block, VARIsTypeParam=n02_is_type_parameter)  # package Synthesize toolkit; Parameters Selector
remap_parameters = Custom[Remap Parameters](VARProceed=n05_proceed, VARListofParameterstoRemap=parameters_selector, VARElementstoWorkon=n01_select_elements_to_work_on, VARIsTypeParameters=n02_is_type_parameter, VARValuetoAdd=n04_value_to_add)  # package Synthesize toolkit; Randomize Parameters

# group: Report
n01_number_of_elements = Watch(remap_parameters.VARNumberofElements)  # "01.Number of Elements"; graph output
n02_elements_to_select = Watch(remap_parameters.VARElementstoselect)  # "02.Elements to Select"; graph output

debug_python_no_message = Custom[Debug Python No Message]()  # package Synthesize toolkit; Debug Python
