# Dynamo graph Parameter.Sequence Number Parameter By Build Order of Family and Type.dyn (Dynamo 2.13.1.3887)
# author: karam@aecedx.com
# packages: Synthesize toolkit 12.5.1

n02_all_elements_of_family_name = BoolSelector(true)  # "02.All Elements of Family Name (All types) ?"; graph input
n01_family_names_separate_by = StringInput("Family")  # "01.Family Names (Separate By Comma , - or * To Select All Matching)"; graph input
n03_specific_type_names_separate = StringInput("Type")  # "03.Specific Type Names (Separate by Comma , )"; graph input
code_block = CodeBlock { ","; false; }
family_and_type_selector = Custom[Family and Type Selector](VARAllElementsofFamilyNameAlltypes=n02_all_elements_of_family_name, VARFamilyName=n01_family_names_separate_by, VARSpecificTypeNamesSeparatebySymbol=n03_specific_type_names_separate, VARSeparationSymbol=code_block.out0, VAROnlyInActiveView=code_block.out1)  # package Synthesize toolkit; Family and Type Selector
n04_select_only_visible_elements = BoolSelector(false)  # "04.Select Only Visible Elements In View ?"; graph input
python_all_elements_in_active = Custom[Python All Elements In Active View]()  # package Synthesize toolkit; Python All Elements In Active View
code_block_2 = CodeBlock { null; }
scopeIf = Custom[CW.ScopeIf+](VARtest=n04_select_only_visible_elements, VARtrue=python_all_elements_in_active, VARfalse=code_block_2)  # package Synthesize toolkit; A (hopefully) more robust implementation of ScopeIf. Tests a single boolean and returns a value accordingly.
scopeIf_2 = Custom[CW.ScopeIf+](VARtest=n04_select_only_visible_elements, VARtrue=code_block_2, VARfalse=family_and_type_selector.VARElements)
create = List.Create(item0=scopeIf, item1=scopeIf_2)
code_block_3 = CodeBlock { false; }
clean = List.Clean(list=create, preserveIndices=code_block_3)
flatten = List.Flatten(list=clean)
python_filter_list_from_another = Custom[Python Filter List From Another List](VARItemsToFilter=family_and_type_selector.VARElements, VARAllItemsToFilterFrom=flatten)  # package Synthesize toolkit; Find Intersections In Lists
clean_2 = List.Clean(list=python_filter_list_from_another, preserveIndices=code_block_3)
n01_elements_to_select = Watch(clean_2)  # "01.Elements to select"; graph output
normalize = BoolSelector(false)  # "10.Normalize"; graph input
n09_repeated_sequence_for_all = BoolSelector(true)  # "09.Repeated Sequence for All Parameters ?"; graph input
code_block_4 = CodeBlock { null; }
n08_reverse_numbers = BoolSelector(false)  # "08.Reverse Numbers ?"; graph input
n06_start_number = DoubleInput(1)  # "06.Start Number"; graph input
boolean = BoolSelector(false)
clean_3 = List.Clean(list=clean_2, preserveIndices=boolean)
ID = Custom[CW.Element.ID](VARelement=clean_3)  # package Synthesize toolkit; Gets the ID(s) for a list of Revit elements (or a single element) - unlike the built-in Element.Id node, this node returns an actual Revit Element ID and *not* a number
number = DoubleInput(0)
count = List.Count(list=ID.VARID)
number_2 = DoubleInput(1)
sequence = Sequence(start=number, amount=count, step=number_2, lacing=Longest)
getItemAtIndex = List.GetItemAtIndex(list=ID.VARID, index=sequence)
byID = Custom[CW.Element.ByID](VARIDUniqueId=getItemAtIndex)  # package Synthesize toolkit; Gets the Revit element(s) for a list of IDs (or a single ID). Optionally retrieves elements from linked documents as well.
count_2 = List.Count(list=byID)
n05_name_of_parameters_to = StringInput("Height")  # "05.Name of Parameters to Sequence (Separate By Comma , - or * To Select All Matching)"; graph input
code_block_5 = CodeBlock { ","; }
parameters_selector = Custom[Parameters Selector](VARElements=clean_3, VARParameterNames=n05_name_of_parameters_to, VARSeparationSymbol=code_block_5)  # package Synthesize toolkit; Parameters Selector
uniqueItems = List.UniqueItems(list=parameters_selector)
parameterExists = Custom[CW.Element.ParameterExists](VARparam=uniqueItems, VARelement=clean_3)  # package Synthesize toolkit; Checks if an element contains a parameter of a given name
firstItem = List.FirstItem(list=parameterExists@L2)
filterByBoolMask = List.FilterByBoolMask(list=uniqueItems, mask=firstItem)
count_3 = List.Count(list=filterByBoolMask.in)
mul = count_2 * count_3
scopeIf_3 = Custom[CW.ScopeIf+](VARtest=n09_repeated_sequence_for_all, VARtrue=count_2, VARfalse=mul)
n07_sequence_steps = DoubleInput(0.1)  # "07.Sequence Steps"; graph input
sequence_2 = Sequence(start=n06_start_number, amount=scopeIf_3, step=n07_sequence_steps, lacing=Longest)
reverse = List.Reverse(list=sequence_2)
scopeIf_4 = Custom[CW.ScopeIf+](VARtest=n08_reverse_numbers, VARtrue=reverse, VARfalse=sequence_2)
flatten_2 = List.Flatten(list=scopeIf_4)
scopeIf_5 = Custom[CW.ScopeIf+](VARtest=n09_repeated_sequence_for_all, VARtrue=code_block_4, VARfalse=flatten_2)
cycle = List.Cycle(list=flatten_2, amount=count_3)
scopeIf_6 = Custom[CW.ScopeIf+](VARtest=n09_repeated_sequence_for_all, VARtrue=cycle, VARfalse=code_block_4)
create_2 = List.Create(item0=scopeIf_5, item1=scopeIf_6)
code_block_6 = CodeBlock { false; }
clean_4 = List.Clean(list=create_2, preserveIndices=code_block_6)
flatten_3 = List.Flatten(list=clean_4)
n11_new_minimum_normalize_true = DoubleInput(0)  # "11.New Minimum (Normalize = True)"; graph input
n12_new_maximum_normalize_true = DoubleInput(1)  # "12.New Maximum (Normalize = True)"; graph input
remapRange = Math.RemapRange(numbers=flatten_3, newMin=n11_new_minimum_normalize_true, newMax=n12_new_maximum_normalize_true)
scopeIf_7 = Custom[CW.ScopeIf+](VARtest=normalize, VARtrue=remapRange, VARfalse=flatten_3)
rounding = DoubleInput(0.01)  # "13.Rounding"; graph input
roundToPrecision = Custom[CW.Math.RoundToPrecision](VARdbl=scopeIf_7, VARprecision=rounding)  # package Synthesize toolkit; Rounds a number to a specified precision
n02_values_generated = Watch(roundToPrecision)  # "02.Values Generated"; graph output
n03_number_of_elements = Watch(count_2)  # "03.Number of Elements"; graph output
n15_proceed = BoolSelector(false)  # "15.Proceed ?"; graph input
code_block_7 = CodeBlock { null; }
scopeIf_8 = Custom[CW.ScopeIf+](VARtest=n15_proceed, VARtrue=roundToPrecision, VARfalse=code_block_7)
chop = List.Chop(list=scopeIf_8, lengths=count_2)
code_block_8 = CodeBlock { false; }
clean_5 = List.Clean(list=chop, preserveIndices=code_block_8)
scopeIf_9 = Custom[CW.ScopeIf+](VARtest=n15_proceed, VARtrue=byID, VARfalse=code_block_7)
clean_6 = List.Clean(list=scopeIf_9, preserveIndices=code_block_8)
flatten_4 = List.Flatten(list=clean_6)
scopeIf_10 = Custom[CW.ScopeIf+](VARtest=n15_proceed, VARtrue=filterByBoolMask.in, VARfalse=code_block_7)
clean_7 = List.Clean(list=scopeIf_10, preserveIndices=code_block_8)
n14_additive = BoolSelector(false)  # "14.Additive ?"; graph input
clean_8 = List.Clean(list=chop)
getParameterValueByName = Element.GetParameterValueByName(element=clean_6, parameterName=clean_7@L1)
add = clean_8 + getParameterValueByName
scopeIf_11 = Custom[CW.ScopeIf+](VARtest=n14_additive, VARtrue=add, VARfalse=clean_8)
flatten_5 = List.Flatten()  # unwired: list
map = List.Map(list=scopeIf_11, f_x=flatten_5)
setParameterByName = Element.SetParameterByName(element=flatten_4, parameterName=clean_7@L1, value=map@L2)
debug_python = Custom[Debug Python]()  # package Synthesize toolkit; Debug Python
