# Dynamo graph Parameter.Sequence Number Parameter By Distance of Spline of Selection Filter.dyn (Dynamo 2.13.1.3887)
# author: karam@aecedx.com
# packages: Synthesize toolkit 12.5.1

hot_get_all_filter = Custom[HOT.Get All Filter]()  # package Synthesize toolkit; Get all Filter
toLower = String.ToLower(string=hot_get_all_filter.VARName)
trimWhitespace = String.TrimWhitespace(string=toLower)
n01_selection_filter_to_read = StringInput("Elements to Sequence")  # "01.Selection Filter to Read"; graph input
toLower_2 = String.ToLower(string=n01_selection_filter_to_read)
trimWhitespace_2 = String.TrimWhitespace(string=toLower_2)
eq = trimWhitespace == trimWhitespace_2
filterByBoolMask = List.FilterByBoolMask(list=hot_get_all_filter.VARElement, mask=eq)
elements = Custom[CW.SelectionSet.Elements](VARselectionSet=filterByBoolMask.in)  # package Synthesize toolkit; Retrieves all elements stored in a selection set
flatten = List.Flatten(list=elements)
boundingBox = Element.BoundingBox(element=flatten)
centerPoint = Custom[ZK.BoundingBox.CenterPoint](VARBoundingBox=boundingBox)  # package Synthesize toolkit; Input Bounding Box element to get its center point. This node is little and lightweight, as it doesn't convert bounding box to geometry to get its centroid point.
n02_select_guide_spline = DSModelElementSelection()  # "02.Select Guide Spline"; nothing selected; graph input
curves = Element.Curves(element=n02_select_guide_spline)
sort_geometry_by_guides = Custom[Sort Geometry By Guides](VARGeometries=centerPoint, VARGuides=curves)  # package Synthesize toolkit; Sort Loft Profiles According to Guide
as_list_sortbykey = Custom[AS.[&] List.SortByKey](VARlist=flatten, VARkeys=sort_geometry_by_guides.VARKeys)  # package Synthesize toolkit; Sort a list (or lists) according to the order specified by the key list.
n01_elements_to_select = Watch(as_list_sortbykey.VARsortedlist)  # "01.Elements to select"; graph output
normalize = BoolSelector(false)  # "08.Normalize"; graph input
n07_repeated_sequence_for_all = BoolSelector(true)  # "07.Repeated Sequence for All Parameters ?"; graph input
code_block = CodeBlock { null; }
n06_reverse_numbers = BoolSelector(false)  # "06.Reverse Numbers ?"; graph input
n04_start_number = DoubleInput(1)  # "04.Start Number"; graph input
boolean = BoolSelector(false)
clean = List.Clean(list=as_list_sortbykey.VARsortedlist, preserveIndices=boolean)
ID = Custom[CW.Element.ID](VARelement=clean)  # package Synthesize toolkit; Gets the ID(s) for a list of Revit elements (or a single element) - unlike the built-in Element.Id node, this node returns an actual Revit Element ID and *not* a number
number = DoubleInput(0)
count = List.Count(list=ID.VARID)
number_2 = DoubleInput(1)
sequence = Sequence(start=number, amount=count, step=number_2, lacing=Longest)
getItemAtIndex = List.GetItemAtIndex(list=ID.VARID, index=sequence)
byID = Custom[CW.Element.ByID](VARIDUniqueId=getItemAtIndex)  # package Synthesize toolkit; Gets the Revit element(s) for a list of IDs (or a single ID). Optionally retrieves elements from linked documents as well.
count_2 = List.Count(list=byID)
n03_name_of_parameters_to = StringInput("Height")  # "03.Name of Parameters to Sequence (Separate By Comma , - or * To Select All Matching)"; graph input
code_block_2 = CodeBlock { ","; }
parameters_selector = Custom[Parameters Selector](VARElements=clean, VARParameterNames=n03_name_of_parameters_to, VARSeparationSymbol=code_block_2)  # package Synthesize toolkit; Parameters Selector
uniqueItems = List.UniqueItems(list=parameters_selector)
parameterExists = Custom[CW.Element.ParameterExists](VARparam=uniqueItems, VARelement=clean)  # package Synthesize toolkit; Checks if an element contains a parameter of a given name
firstItem = List.FirstItem(list=parameterExists@L2)
filterByBoolMask_2 = List.FilterByBoolMask(list=uniqueItems, mask=firstItem)
count_3 = List.Count(list=filterByBoolMask_2.in)
mul = count_2 * count_3
scopeIf = Custom[CW.ScopeIf+](VARtest=n07_repeated_sequence_for_all, VARtrue=count_2, VARfalse=mul)  # package Synthesize toolkit; A (hopefully) more robust implementation of ScopeIf. Tests a single boolean and returns a value accordingly.
n05_sequence_steps = DoubleInput(0.1)  # "05.Sequence Steps"; graph input
sequence_2 = Sequence(start=n04_start_number, amount=scopeIf, step=n05_sequence_steps, lacing=Longest)
reverse = List.Reverse(list=sequence_2)
scopeIf_2 = Custom[CW.ScopeIf+](VARtest=n06_reverse_numbers, VARtrue=reverse, VARfalse=sequence_2)
flatten_2 = List.Flatten(list=scopeIf_2)
scopeIf_3 = Custom[CW.ScopeIf+](VARtest=n07_repeated_sequence_for_all, VARtrue=code_block, VARfalse=flatten_2)
cycle = List.Cycle(list=flatten_2, amount=count_3)
scopeIf_4 = Custom[CW.ScopeIf+](VARtest=n07_repeated_sequence_for_all, VARtrue=cycle, VARfalse=code_block)
create = List.Create(item0=scopeIf_3, item1=scopeIf_4)
code_block_3 = CodeBlock { false; }
clean_2 = List.Clean(list=create, preserveIndices=code_block_3)
flatten_3 = List.Flatten(list=clean_2)
n09_new_minimum_normalize_true = DoubleInput(0)  # "09.New Minimum (Normalize = True)"; graph input
n10_new_maximum_normalize_true = DoubleInput(1)  # "10.New Maximum (Normalize = True)"; graph input
remapRange = Math.RemapRange(numbers=flatten_3, newMin=n09_new_minimum_normalize_true, newMax=n10_new_maximum_normalize_true)
scopeIf_5 = Custom[CW.ScopeIf+](VARtest=normalize, VARtrue=remapRange, VARfalse=flatten_3)
rounding = DoubleInput(0.01)  # "11.Rounding"; graph input
roundToPrecision = Custom[CW.Math.RoundToPrecision](VARdbl=scopeIf_5, VARprecision=rounding)  # package Synthesize toolkit; Rounds a number to a specified precision
n02_values_generated = Watch(roundToPrecision)  # "02.Values Generated"; graph output
n03_number_of_elements = Watch(count_2)  # "03.Number of Elements"; graph output
n13_proceed = BoolSelector(false)  # "13.Proceed ?"; graph input
code_block_4 = CodeBlock { null; }
scopeIf_6 = Custom[CW.ScopeIf+](VARtest=n13_proceed, VARtrue=roundToPrecision, VARfalse=code_block_4)
chop = List.Chop(list=scopeIf_6, lengths=count_2)
code_block_5 = CodeBlock { false; }
clean_3 = List.Clean(list=chop, preserveIndices=code_block_5)
scopeIf_7 = Custom[CW.ScopeIf+](VARtest=n13_proceed, VARtrue=byID, VARfalse=code_block_4)
clean_4 = List.Clean(list=scopeIf_7, preserveIndices=code_block_5)
flatten_4 = List.Flatten(list=clean_4)
scopeIf_8 = Custom[CW.ScopeIf+](VARtest=n13_proceed, VARtrue=filterByBoolMask_2.in, VARfalse=code_block_4)
clean_5 = List.Clean(list=scopeIf_8, preserveIndices=code_block_5)
n12_additive = BoolSelector(false)  # "12.Additive ?"; graph input
clean_6 = List.Clean(list=chop)
getParameterValueByName = Element.GetParameterValueByName(element=clean_4, parameterName=clean_5@L1)
add = clean_6 + getParameterValueByName
scopeIf_9 = Custom[CW.ScopeIf+](VARtest=n12_additive, VARtrue=add, VARfalse=clean_6)
flatten_5 = List.Flatten()  # unwired: list
map = List.Map(list=scopeIf_9, f_x=flatten_5)
setParameterByName = Element.SetParameterByName(element=flatten_4, parameterName=clean_5@L1, value=map@L2)
debug_python = Custom[Debug Python]()  # package Synthesize toolkit; Debug Python
