# Dynamo graph Parameter.Sequence Text Parameter By Build Order of Family and Type.dyn (Dynamo 2.13.1.3887)
# author: karam@aecedx.com
# packages: Synthesize toolkit 12.5.1

n02_all_elements_of_family_name = BoolSelector(true)  # "02.All Elements of Family Name (All types) ?"; graph input
n01_family_names_separate_by = StringInput("Family")  # "01.Family Names (Separate By Comma , - or * To Select All Matching)"; graph input
n03_specific_type_names_separate = StringInput("Type")  # "03.Specific Type Names (Separate by Comma , )"; graph input
code_block = CodeBlock { ","; false; }
family_and_type_selector = Custom[Family and Type Selector](VARAllElementsofFamilyNameAlltypes=n02_all_elements_of_family_name, VARFamilyName=n01_family_names_separate_by, VARSpecificTypeNamesSeparatebySymbol=n03_specific_type_names_separate, VARSeparationSymbol=code_block.out0, VAROnlyInActiveView=code_block.out1)  # package Synthesize toolkit; Family and Type Selector
n04_select_only_visible_elements = BoolSelector(false)  # "04.Select Only Visible Elements In View ?"; graph input
python_all_elements_in_active = Custom[Python All Elements In Active View]()  # package Synthesize toolkit; Python All Elements In Active View
code_block_2 = CodeBlock { null; }
scopeIf = Custom[CW.ScopeIf+](VARtest=n04_select_only_visible_elements, VARtrue=python_all_elements_in_active, VARfalse=code_block_2)  # package Synthesize toolkit; A (hopefully) more robust implementation of ScopeIf. Tests a single boolean and returns a value accordingly.
scopeIf_2 = Custom[CW.ScopeIf+](VARtest=n04_select_only_visible_elements, VARtrue=code_block_2, VARfalse=family_and_type_selector.VARElements)
create = List.Create(item0=scopeIf, item1=scopeIf_2)
code_block_3 = CodeBlock { false; }
clean = List.Clean(list=create, preserveIndices=code_block_3)
flatten = List.Flatten(list=clean)
python_filter_list_from_another = Custom[Python Filter List From Another List](VARItemsToFilter=family_and_type_selector.VARElements, VARAllItemsToFilterFrom=flatten)  # package Synthesize toolkit; Find Intersections In Lists
clean_2 = List.Clean(list=python_filter_list_from_another, preserveIndices=code_block_3)

# group: Input
n05_parameter_to_work_on = StringInput("Mark")  # "05.Parameter to work on"; graph input
n06_prefix_to_add_can_be_empty = StringInput("")  # "06.Prefix to Add (Can be Empty) ?"; graph input
n07_number_sequence_start = DoubleInput(1)  # "07.Number Sequence Start"; graph input
n10_remove_0_s_ignores_no_of = BoolSelector(false)  # "10.Remove 0's (Ignores No of Digits)"; graph input
n09_no_of_digits = DoubleSlider(2, range=1..3 step 1)  # "09.No.of Digits"; graph input
n08_suffix_to_add_can_be_empty = StringInput("")  # "08.Suffix to Add (Can be Empty) ?"; graph input
n11_reverse_naming = BoolSelector(false)  # "11.Reverse Naming"; graph input

count = List.Count(list=clean_2)
sequenced_string_numbers = Custom[Sequenced String Numbers Generate](VARCountofElements=count, VARPrefixtoAddCanbeEmpty=n06_prefix_to_add_can_be_empty, VARNumberSequenceStart=n07_number_sequence_start, VARRemove0s=n10_remove_0_s_ignores_no_of, VAR=n09_no_of_digits, VARSuffixtoAddCanbeEmpty=n08_suffix_to_add_can_be_empty, VARReverseNaming=n11_reverse_naming)  # package Synthesize toolkit; Sequenced String Numbers Generate
setParameterByName = Element.SetParameterByName(element=clean_2, parameterName=n05_parameter_to_work_on, value=sequenced_string_numbers.VARValues)

# group: Report
n01_number_of_selected_elements = Watch(sequenced_string_numbers.VARNumberofSelectedElements)  # "01.Number of Selected Elements"; graph output
report = Watch(sequenced_string_numbers.VARReport)  # "02.Report"; graph output

debug_python = Custom[Debug Python]()  # package Synthesize toolkit; Debug Python
