# Dynamo graph Parameter.Sequence Text Parameter By Distance of Spline of Selection.dyn (Dynamo 2.13.1.3887)
# author: karam@aecedx.com
# packages: Synthesize toolkit 12.5.1

# group: Input
n01_select_elements_to_work_on = DSModelElementsSelection()  # "01.Select Elements to work on"; nothing selected; graph input
n02_select_guide_spline = DSModelElementSelection()  # "02.Select Guide Spline"; nothing selected; graph input
n03_parameter_to_work_on = StringInput("Mark")  # "03.Parameter to work on"; graph input
n04_prefix_to_add_can_be_empty = StringInput("")  # "04.Prefix to Add (Can be Empty) ?"; graph input
n05_number_sequence_start = DoubleInput(1)  # "05.Number Sequence Start"; graph input
n08_remove_0_s_ignores_no_of = BoolSelector(false)  # "08.Remove 0's (Ignores No of Digits)"; graph input
n07_no_of_digits = DoubleSlider(2, range=1..3 step 1)  # "07.No.of Digits"; graph input
n06_suffix_to_add_can_be_empty = StringInput("")  # "06.Suffix to Add (Can be Empty) ?"; graph input
n09_reverse_naming = BoolSelector(false)  # "09.Reverse Naming"; graph input

boundingBox = Element.BoundingBox(element=n01_select_elements_to_work_on)
centerPoint = Custom[ZK.BoundingBox.CenterPoint](VARBoundingBox=boundingBox)  # package Synthesize toolkit; Input Bounding Box element to get its center point. This node is little and lightweight, as it doesn't convert bounding box to geometry to get its centroid point.
curves = Element.Curves(element=n02_select_guide_spline)
sort_geometry_by_guides = Custom[Sort Geometry By Guides](VARGeometries=centerPoint, VARGuides=curves)  # package Synthesize toolkit; Sort Loft Profiles According to Guide
as_list_sortbykey = Custom[AS.[&] List.SortByKey](VARlist=n01_select_elements_to_work_on, VARkeys=sort_geometry_by_guides.VARKeys)  # package Synthesize toolkit; Sort a list (or lists) according to the order specified by the key list.
count = List.Count(list=as_list_sortbykey.VARsortedlist)
sequenced_string_numbers = Custom[Sequenced String Numbers Generate](VARCountofElements=count, VARPrefixtoAddCanbeEmpty=n04_prefix_to_add_can_be_empty, VARNumberSequenceStart=n05_number_sequence_start, VARRemove0s=n08_remove_0_s_ignores_no_of, VAR=n07_no_of_digits, VARSuffixtoAddCanbeEmpty=n06_suffix_to_add_can_be_empty, VARReverseNaming=n09_reverse_naming)  # package Synthesize toolkit; Sequenced String Numbers Generate
setParameterByName = Element.SetParameterByName(element=as_list_sortbykey.VARsortedlist, parameterName=n03_parameter_to_work_on, value=sequenced_string_numbers.VARValues)

# group: Report
n01_number_of_selected_elements = Watch(sequenced_string_numbers.VARNumberofSelectedElements)  # "01.Number of Selected Elements"; graph output
report = Watch(sequenced_string_numbers.VARReport)  # "02.Report"; graph output

debug_python = Custom[Debug Python]()  # package Synthesize toolkit; Debug Python
