# Dynamo graph Parts.Create From Links.dyn (Dynamo 2.13.1.3887)
# author: karam@aecedx.com
# packages: Synthesize toolkit 12.5.1

al_get_documents = Custom[AL.Get Documents]()  # package Synthesize toolkit; Queries all linked Revit files and retrieves their Name, LinkInstance and Document properties.
n01_links_names_with_numbers = Watch(al_get_documents.VARLinkName)  # "01.Links' Names with Numbers"; graph output
n04_create_a_filter_for_parts = BoolSelector(true)  # "04.Create a Filter For Parts from Link ?"; graph input
n05_filter_name_to_create = StringInput("Dynamo Linked Parts")  # "05.Filter Name to Create"; graph input
n06_overwrite_existing_filter = BoolSelector(false)  # "06.Overwrite Existing Filter ? (False for Adding Elements)"; graph input
n03_proceed = BoolSelector(false)  # "03.Proceed ?"; graph input
code_block = CodeBlock { null; }
scopeIf = Custom[CW.ScopeIf+](VARtest=n03_proceed, VARtrue=al_get_documents.VARLinkDoc, VARfalse=code_block)  # package Synthesize toolkit; A (hopefully) more robust implementation of ScopeIf. Tests a single boolean and returns a value accordingly.
n02_link_number_to_choose = DoubleInput(0)  # "02.Link Number to choose ?"; graph input
getItemAtIndex = List.GetItemAtIndex(list=scopeIf, index=n02_link_number_to_choose)
create = List.Create(item0=getItemAtIndex)
flatten = List.Flatten(list=create)
code_block_2 = CodeBlock { false; }
clean = List.Clean(list=flatten, preserveIndices=code_block_2)
scopeIf_2 = Custom[CW.ScopeIf+](VARtest=n03_proceed, VARtrue=al_get_documents.VARLinkInstance, VARfalse=code_block)
getItemAtIndex_2 = List.GetItemAtIndex(list=scopeIf_2, index=n02_link_number_to_choose)
create_2 = List.Create(item0=getItemAtIndex_2)
flatten_2 = List.Flatten(list=create_2)
clean_2 = List.Clean(list=flatten_2, preserveIndices=code_block_2)
n01_category_to_create_it_s_parts = Categories("OST_Walls")  # "01.Category to Create It's Parts"; graph input
getFromLinkedFile = Custom[ST.Element.GetFromLinkedFile](VARLinkInstance=clean_2, VARLinkDocument=clean, VARCategory=n01_category_to_create_it_s_parts)  # package Synthesize toolkit; Get elements from link document instance based on category
python_null_2_empty = Custom[Python Null 2 Empty](VARIN=getFromLinkedFile)  # package Synthesize toolkit; Python Null 2 Empty
code_block_3 = CodeBlock { false; }
clean_3 = List.Clean(list=python_null_2_empty, preserveIndices=code_block_3)
flatten_3 = List.Flatten(list=clean_3)
count = List.Count(list=flatten_3)
cycle = List.Cycle(list=clean, amount=count)
create_3 = List.Create(item0=flatten_3)
flatten_4 = List.Flatten(list=create_3)
clean_4 = List.Clean(list=flatten_4, preserveIndices=code_block_2)
slabShapeHasBeenModified = Custom[CW.Roof.SlabShapeHasBeenModified](VARroof=flatten_3)  # package Synthesize toolkit; Checks if the shape of a roof slab has been modified with the shape editing tools
filterByBoolMask = List.FilterByBoolMask(list=clean_4, mask=slabShapeHasBeenModified)
code_block_4 = CodeBlock { "Angle"; }
parameterExists = Custom[CW.Element.ParameterExists](VARparam=code_block_4, VARelement=filterByBoolMask.out)  # package Synthesize toolkit; Checks if an element contains a parameter of a given name
filterByBoolMask_2 = List.FilterByBoolMask(list=filterByBoolMask.out, mask=parameterExists)
bk_create_parts_for_linked = Custom[BK.Create Parts for Linked Elements](VARlinkDocumentList_sameLength=cycle, VARlinkedElementList=filterByBoolMask_2.out)  # package Synthesize toolkit; currently does not handle multiple instances of Link
isNull = Object.IsNull(object=bk_create_parts_for_linked)
end = Revit.Transaction.Transaction.End(input=bk_create_parts_for_linked)
passthrough = Custom[CW.Passthrough](VARpassThrough=isNull, VARwaitFor=end)  # package Synthesize toolkit; Forces a sequential order of execution. The node wired into the output of the Passthrough node will be executed *after* the node wired into the waitFor input (e.g. important for some Revit operations). The value of the passThrough input will be passed on to the node wired into the output port of the Passthrough node.
categories = Categories("OST_Parts")
scopeIf_3 = Custom[CW.ScopeIf+](VARtest=passthrough, VARtrue=categories, VARfalse=categories)
uniqueItems = List.UniqueItems(list=scopeIf_3)
all_elements_of_category = ElementsOfCategory(Category=uniqueItems)
flatten_5 = List.Flatten(list=all_elements_of_category)
id = Element.Id(element=filterByBoolMask_2.out)
string_from_object = FromObject(obj=id)
bk_get_linkelementids_from_parts = Custom[BK.Get LinkElementIds from Parts](VARpartList=flatten_5)  # package Synthesize toolkit
flatten_6 = List.Flatten(list=bk_get_linkelementids_from_parts.VARallParents)
bk_get_link_instance_and_element = Custom[BK.Get Link Instance and Element Ids from LinkElementId Object](VARLinkElementIds=flatten_6)  # package Synthesize toolkit
string_from_object_2 = FromObject(obj=bk_get_link_instance_and_element.VARLinkedElementIds)
equals = Custom[LF.IndexOf.Equals](VARlistA=string_from_object, VARlistB=string_from_object_2)  # package Synthesize toolkit; Returns the indices of items in list B that are equal to items in list A.
getItemAtIndex_3 = List.GetItemAtIndex(list=flatten_5, index=equals)
code_block_5 = CodeBlock { null; }
scopeIf_4 = Custom[CW.ScopeIf+](VARtest=n04_create_a_filter_for_parts, VARtrue=getItemAtIndex_3, VARfalse=code_block_5)
boolean = BoolSelector(false)
clean_5 = List.Clean(list=scopeIf_4, preserveIndices=boolean)
generate_selection_filter = Custom[Generate Selection Filter](VARCreateSelectionFilter=n04_create_a_filter_for_parts, VARFilterNametoCreate=n05_filter_name_to_create, VAROverwriteExistingFilter=n06_overwrite_existing_filter, VARElements=clean_5)  # package Synthesize toolkit; Generate Selection FIlter
debug_python = Custom[Debug Python]()  # package Synthesize toolkit; Debug Python
