# Dynamo graph Parts.Level Auto Fix.dyn (Dynamo 2.13.1.3887)
# author: karam@aecedx.com
# packages: Synthesize toolkit 12.5.1

fix_factor_depends_of_project = DoubleInput(1000)  # "Fix Factor (Depends of Project Units, 1 For meters for example, and 100 for Centimeters)"

# group: Input
n03_maximum_floors_thickness_used = DoubleInput(0.3)  # "03.Maximum Floors Thickness used in Project"; graph input
n01_filtered_parts_false_all = BoolSelector(true)  # "01.Filtered Parts = False | All Parts = True"; graph input
n02_parts_filter_to_read = StringInput("Linked Walls Parts")  # "02.Parts filter to read"; graph input

parts_level_auto_fix = Custom[Parts Level Auto Fix](VARFixFactorDependsofProjectUnits1Formetersforexampleand100forCentimeters=fix_factor_depends_of_project, VARMaximumFloorsThicknessusedinProject=n03_maximum_floors_thickness_used, VARFilteredParts=n01_filtered_parts_false_all, VARPartsfiltertoread=n02_parts_filter_to_read)  # package Synthesize toolkit; Parts Level Auto Fix
debug_python = Custom[Debug Python]()  # package Synthesize toolkit; Debug Python
