# Dynamo graph Ramp.Create By Floors.dyn (Dynamo 2.13.1.3887)
# author: karam@aecedx.com
# packages: Synthesize toolkit 12.5.1

code_block = CodeBlock { false; true; }

# group: Input
n03_control_points_distancing = DoubleInput(0.75)  # "03.Control Points Distancing"; graph input
n02_select_floors = DSModelElementsSelection()  # "02.Select Floors"; nothing selected; graph input
n01_select_ramps_start_end_edges = SelectEdges()  # "01.Select Ramps Start/End Edges"; nothing selected; graph input
n04_floor_offset = DoubleInput(1)  # "04.Floor Offset"; graph input
n05_opening_offset_must_be_more = DoubleInput(1.5)  # "05.Opening Offset (Must Be More Than Floor Offset)"; graph input

turnIntoList = Custom[CW.TurnIntoList](VARunknownItem=n02_select_floors)  # package Synthesize toolkit; Turns an element (or a nested list) into a flat list
flatten = List.Flatten(list=turnIntoList)
code_block_2 = CodeBlock { "Floor"; }
byClassName = Custom[SP.Filter.ByClassName](VARobject=flatten, VARclassName=code_block_2)  # package Synthesize toolkit; Filters a list of objects by the object's class name. Note that Dynamo elements belong to different classes than their Revit counterparts. Use the Object.Class node to check an object's class.
elementSketch = Custom[SP.Collector.ElementSketch](VARelement=byClassName.VARin)  # package Synthesize toolkit; Get the actual sketch lines of a sketch based element (floor, ceiling, modified wall, etc.) . You can optionally fetch the matching model curves, however this might prove comptationally heavy on larger data sets.
as_polycurve_bycurves = Custom[AS.[&] PolyCurve.ByCurves](VARcurves=elementSketch.VARcurves)  # package Synthesize toolkit; Create polycurves from an unordered list of curves.
flatten_2 = List.Flatten(list=as_polycurve_bycurves.VARpolyCurve)
turnIntoList_2 = Custom[CW.TurnIntoList](VARunknownItem=n01_select_ramps_start_end_edges)
flatten_3 = List.Flatten(list=turnIntoList_2)
code_block_3 = CodeBlock { 0.5; }
pointAtParameter = Curve.PointAtParameter(curve=flatten_3, param=code_block_3)
python_script = Python(IN[0]=flatten_2, IN[1]=pointAtParameter)  # IronPython2
# ---------- python_script.python (60 lines) ----------
# Enable Python support and load DesignScript library
# IMPORTANT : ALL DYNAMO DESIGN SCRIPT NODES ARE AS (dg)
import clr
clr.AddReference('ProtoGeometry')
from Autodesk.DesignScript import Geometry as dg

# EXTENSION Enable ToDSType
clr.AddReference('RevitNodes')
import Revit
clr.ImportExtensions(Revit.Elements)

# Enable Revit Elements
from Revit.Elements import *

# EXTENSION Enable Geometry Conversion Methods
clr.ImportExtensions(Revit.GeometryConversion)

# Enable Revit API
clr.AddReference('RevitAPI')
from Autodesk.Revit.DB import *

# Enable DocumentManager and TransactionManager
clr.AddReference('RevitServices')
from RevitServices.Persistence import DocumentManager
from RevitServices.Transactions import TransactionManager

# Enable ICollection List Translate
clr.AddReference("System")
import System.Collections.Generic
from System.Collections.Generic import List

dataEnteringNode = IN
# Use UnwrapElement(IN[0]) When Translating From Dynamo to Revit
lines=UnwrapElement(IN[0])
pts=UnwrapElement(IN[1])
# Choose The Current Document
doc = DocumentManager.Instance.CurrentDBDocument
uidoc = DocumentManager.Instance.CurrentUIApplication.ActiveUIDocument
uiapp = DocumentManager.Instance.CurrentUIApplication
app = uiapp.Application

def doesinter(a,b,tollerance = 0.1):
	if round(dg.Geometry.DistanceTo(a,b),2) < tollerance:
		return True
	else:
		return False

# Create Empty List
result = []

groups = []
for l in lines:
	tmp = []
	for p in pts:
		if doesinter(l,p):
			tmp.append(p)
	groups.append(tmp)

# Assign your output to the OUT variable.
OUT = groups
# ----------------------------------------
curves = PolyCurve.Curves(polyCurve=flatten_2)
curves_offset_to_revit = Custom[Curves Offset To Revit Compatibility](VARCurves=curves, VAROffset=n04_floor_offset)  # package Synthesize toolkit; Curves Offset To Revit Compatibility
removeItemAtIndex = List.RemoveItemAtIndex(list=curves, indices=curves_offset_to_revit.VARFailIndex)
python_script_2 = Python(IN[0]=python_script, IN[1]=removeItemAtIndex, IN[2]=curves_offset_to_revit.VARCurves)  # IronPython2
# ---------- python_script_2.python (129 lines) ----------
# Enable Python support and load DesignScript library
# IMPORTANT : ALL DYNAMO DESIGN SCRIPT NODES ARE AS (dg)
import clr
clr.AddReference('ProtoGeometry')
from Autodesk.DesignScript import Geometry as dg

# EXTENSION Enable ToDSType
clr.AddReference('RevitNodes')
import Revit
clr.ImportExtensions(Revit.Elements)

# Enable Revit Elements
from Revit.Elements import *

# EXTENSION Enable Geometry Conversion Methods
clr.ImportExtensions(Revit.GeometryConversion)

# Enable Revit API
clr.AddReference('RevitAPI')
from Autodesk.Revit.DB import *

# Enable DocumentManager and TransactionManager
clr.AddReference('RevitServices')
from RevitServices.Persistence import DocumentManager
from RevitServices.Transactions import TransactionManager

# Enable ICollection List Translate
clr.AddReference("System")
import System.Collections.Generic
from System.Collections.Generic import List

dataEnteringNode = IN
# Use UnwrapElement(IN[0]) When Translating From Dynamo to Revit
allpts = UnwrapElement(IN[0])
lines = UnwrapElement(IN[1])
offsetlines = UnwrapElement(IN[2])

# Choose The Current Document
doc = DocumentManager.Instance.CurrentDBDocument
uidoc = DocumentManager.Instance.CurrentUIApplication.ActiveUIDocument
uiapp = DocumentManager.Instance.CurrentUIApplication
app = uiapp.Application

def doesinter(a,b,tollerance = 0.1):
	if round(dg.Geometry.DistanceTo(a,b),2) < tollerance:
		return True
	else:
		return False


def op(list,currentoffset,pts):
	tojoin = []
	tokeep = []
	tokeepinterior = []
	tokeeporg = []
	innercount = 0
	if len(currentoffset) == len(list):
		for l in list:
			lp = dg.Curve.PointAtParameter(l,0.5)
			isgood = True
			for p in pts:
				if doesinter(lp,p):
					isgood = False
					break
			if isgood:
				tojoin.append(currentoffset[innercount])
				tokeepinterior.append(l)
			else:
				tokeep.append(currentoffset[innercount])
				tokeeporg.append(l)
			innercount += 1
	else:
		tokeepindices = []
		for p in pts:
			dises = []
			for l in list:
				dises.append(dg.Geometry.DistanceTo(p,l))
			mindis = min(dises)
			dcount = 0			
			for d in dises:
				if mindis == d:
					tokeepindices.append(dcount)
				dcount += 1
		tokeeporgindices = []
		for p in pts:
			dises = []
			for l in currentoffset:
				dises.append(dg.Geometry.DistanceTo(p,l))
			mindis = min(dises)
			dcount = 0			
			for d in dises:
				if mindis == d:
					tokeeporgindices.append(dcount)
				dcount += 1
		finalcounter = 0
		for l in list:
			if finalcounter in tokeepindices:
				tokeeporg.append(l)
			else:
				tokeepinterior.append(l)
			finalcounter += 1
		finalcounter = 0
		for l in currentoffset:
			if finalcounter in tokeeporgindices:
				tokeep.append(l)
			else:
				tojoin.append(l)
			finalcounter += 1

	return tojoin,tokeep,tokeepinterior,tokeeporg
# Create Empty List
tojoinstuff = []
tokeepstuff = []
tokeeporgstuff = []
tokeepinteriorstuff = []

count = 0
for list in lines:
	currentoffset = offsetlines[count]
	pts = allpts[count]
	count += 1
	operate = op(list,currentoffset,pts)
	tojoinstuff.append(operate[0])
	tokeepstuff.append(operate[1])
	tokeepinteriorstuff.append(operate[2])
	tokeeporgstuff.append(operate[3])
	
# Assign your output to the OUT variable.
OUT = tojoinstuff,tokeepstuff,tokeepinteriorstuff,tokeeporgstuff
# ----------------------------------------
code_block_4 = CodeBlock(a=python_script_2) { a[0]; a[1]; a[2]; a[3]; }
smooth_curves = Custom[Smooth Curves](VARForceClose=code_block.out0, VARPointsDistance=n03_control_points_distancing, VARCurves=code_block_4.out0@L2, VARSmoothMode=code_block.out1)  # package Synthesize toolkit; Smooth Curves
python_all_elements_in_all = Custom[Python All Elements In All Document]()  # package Synthesize toolkit; Python All Elements In All Document
combined_bounding_box_of = Custom[Combined Bounding Box of Elements](VARelements=python_all_elements_in_all)  # package Synthesize toolkit; Combined Bounding Box of Elements
minPoint = BoundingBox.MinPoint(boundingBox=combined_bounding_box_of)
maxPoint = BoundingBox.MaxPoint(boundingBox=combined_bounding_box_of)
byStartPointEndPoint = Line.ByStartPointEndPoint(startPoint=minPoint, endPoint=maxPoint)
length = Curve.Length(curve=byStartPointEndPoint)
extendStart = Curve.ExtendStart(distance=length)  # unwired: curve
extendEnd = Curve.ExtendEnd(distance=length)  # unwired: curve
compose = ComposeFunctions(func0=extendStart, func1=extendEnd)  # "Function.Compose"
apply = ApplyFunction(func=compose, arg1=code_block_4.out3)  # "Function.Apply"
count = List.Count(list=apply@L2)
code_block_5 = CodeBlock { 2; }
eq = count == code_block_5
filterByBoolMask = List.FilterByBoolMask(list=smooth_curves, mask=eq)
filterByBoolMask_2 = List.FilterByBoolMask(list=apply, mask=eq)
python_script_3 = Python(IN[0]=filterByBoolMask.in, IN[1]=filterByBoolMask_2.in)  # IronPython2
# ---------- python_script_3.python (94 lines) ----------
# Enable Python support and load DesignScript library
# IMPORTANT : ALL DYNAMO DESIGN SCRIPT NODES ARE AS (dg)
import clr
clr.AddReference('ProtoGeometry')
from Autodesk.DesignScript import Geometry as dg

# EXTENSION Enable ToDSType
clr.AddReference('RevitNodes')
import Revit
clr.ImportExtensions(Revit.Elements)

# Enable Revit Elements
from Revit.Elements import *

# EXTENSION Enable Geometry Conversion Methods
clr.ImportExtensions(Revit.GeometryConversion)

# Enable Revit API
clr.AddReference('RevitAPI')
from Autodesk.Revit.DB import *

# Enable DocumentManager and TransactionManager
clr.AddReference('RevitServices')
from RevitServices.Persistence import DocumentManager
from RevitServices.Transactions import TransactionManager

# Enable ICollection List Translate
clr.AddReference("System")
import System.Collections.Generic
from System.Collections.Generic import List

dataEnteringNode = IN
# Use UnwrapElement(IN[0]) When Translating From Dynamo to Revit
smoothlines = UnwrapElement(IN[0])
extendlines = UnwrapElement(IN[1])

# Choose The Current Document
doc = DocumentManager.Instance.CurrentDBDocument
uidoc = DocumentManager.Instance.CurrentUIApplication.ActiveUIDocument
uiapp = DocumentManager.Instance.CurrentUIApplication
app = uiapp.Application

def doesinter(a,b,tollerance = 0.1):
	if round(dg.Geometry.DistanceTo(a,b),2) < tollerance:
		return True
	else:
		return False

def interop(ex,s):
	allpts = dg.Geometry.Intersect(ex,s)
	cleanpts = []
	for a in allpts:
		if "Point" in a.ToString():
			cleanpts.append(a)
	if len(cleanpts) > 0:
		midp = dg.Curve.PointAtParameter(ex,0.5)
		dises = []
		for cp in cleanpts:
			dises.append(dg.Geometry.DistanceTo(cp,midp))
		mindis = min(dises)
		dicount = 0
		for di in dises:
			if mindis == di:
				closestpoint = cleanpts[dicount]
			dicount += 1
	else:
		closestpoint = dg.Geometry.ClosestPointTo(ex,s)
	return closestpoint

result = []
resultex = []
count = 0
for sline in smoothlines:
	currentex = extendlines[count]
	count += 1
	tmps = []
	tmpex = []
	for s in sline:
		tmp = []
		for ex in currentex:
			closestpoint = interop(ex,s)
			tmp.append(dg.Curve.ParameterAtPoint(s,closestpoint))
		tmps.append(dg.Curve.TrimByParameter(s,tmp[0],tmp[1]))
	result.append(tmps)	
	for ex in currentex:
		tmp2 = []
		for s in sline:
			closestpoint = interop(ex,s)
			tmp2.append(dg.Curve.ParameterAtPoint(ex,closestpoint))
		tmpex.append(dg.Curve.TrimByParameter(ex,tmp2[0],tmp2[1]))	
	resultex.append(tmpex)

# Assign your output to the OUT variable.
OUT = result,resultex
# ----------------------------------------
transpose = List.Transpose(lists=python_script_3)
flatten_4 = List.Flatten(list=transpose@L3)
as_polycurve_bycurves_2 = Custom[AS.[&] PolyCurve.ByCurves](VARcurves=flatten_4)
flatten_5 = List.Flatten(list=as_polycurve_bycurves_2.VARpolyCurve)
explode = Geometry.Explode(geometry=flatten_5)
filterByBoolMask_3 = List.FilterByBoolMask(list=byClassName.VARin, mask=eq)
elementType = Element.ElementType(element=filterByBoolMask_3.in)
code_block_6 = CodeBlock { "Level"; }
getParameterValueByName = Element.GetParameterValueByName(element=filterByBoolMask_3.in, parameterName=code_block_6)
byOutlineTypeAndLevel = Floor.ByOutlineTypeAndLevel(outlineCurves=explode, floorType=elementType, level=getParameterValueByName)
join = List.Join()  # unwired: list0, list1, list2, list3
code_block_7 = CodeBlock { false; true; }
curves_offset_to_revit_2 = Custom[Curves Offset To Revit Compatibility](VARCurves=removeItemAtIndex, VAROffset=n05_opening_offset_must_be_more)
python_script_4 = Python(IN[0]=python_script, IN[1]=removeItemAtIndex, IN[2]=curves_offset_to_revit_2.VARCurves)  # IronPython2; same code as python_script_2
code_block_8 = CodeBlock(a=python_script_4) { a[0]; a[1]; a[2]; a[3]; }
smooth_curves_2 = Custom[Smooth Curves](VARForceClose=code_block_7.out0, VARPointsDistance=n03_control_points_distancing, VARCurves=code_block_8.out0@L2, VARSmoothMode=code_block_7.out1)
filterByBoolMask_4 = List.FilterByBoolMask(list=smooth_curves_2, mask=eq)
python_script_5 = Python(IN[0]=filterByBoolMask_4.in, IN[1]=filterByBoolMask_2.in)  # IronPython2; same code as python_script_3
transpose_2 = List.Transpose(lists=python_script_5)
code_block_9 = CodeBlock { 0; }
getItemAtIndex = List.GetItemAtIndex(list=transpose_2@L3, index=code_block_9)
filterByBoolMask_5 = List.FilterByBoolMask(list=code_block_4.out2, mask=eq)
as_polycurve_bycurves_3 = Custom[AS.[&] PolyCurve.ByCurves](VARcurves=filterByBoolMask_5.in)
endPoint = Curve.EndPoint(curve=as_polycurve_bycurves_3.VARpolyCurve)
endPoint_2 = Curve.EndPoint(curve=getItemAtIndex)
byStartPointEndPoint_2 = Line.ByStartPointEndPoint(startPoint=endPoint, endPoint=endPoint_2)
startPoint = Curve.StartPoint(curve=getItemAtIndex)
startPoint_2 = Curve.StartPoint(curve=as_polycurve_bycurves_3.VARpolyCurve)
byStartPointEndPoint_3 = Line.ByStartPointEndPoint(startPoint=startPoint, endPoint=startPoint_2)
combine = List.Combine(comb=join, list1=getItemAtIndex, list2=byStartPointEndPoint_2, list3=filterByBoolMask_5.in, list4=byStartPointEndPoint_3)
as_polycurve_bycurves_4 = Custom[AS.[&] PolyCurve.ByCurves](VARcurves=combine)
curves_2 = PolyCurve.Curves(polyCurve=as_polycurve_bycurves_4.VARpolyCurve)
python_script_6 = Python(IN[0]=byOutlineTypeAndLevel, IN[1]=curves_2, IN[2]=filterByBoolMask_3.in, IN[3]=curves_offset_to_revit.VARFailIndex)  # IronPython2
# ---------- python_script_6.python (56 lines) ----------
import clr
clr.AddReference("RevitAPI")
from Autodesk.Revit.DB import *

clr.AddReference("RevitServices")
import RevitServices
from RevitServices.Persistence import DocumentManager
from RevitServices.Transactions import TransactionManager
doc =  DocumentManager.Instance.CurrentDBDocument

clr.AddReference("RevitNodes")
import Revit
clr.ImportExtensions(Revit.Elements)
clr.ImportExtensions(Revit.GeometryConversion)

clr.AddReference("RevitAPIUI")
from Autodesk.Revit.UI import TaskDialog

flr = UnwrapElement(IN[0])
hole = UnwrapElement(IN[1])
oldfls = UnwrapElement(IN[2])
msg = IN[3]
openings = []
title = "AECedx - Karam"

TransactionManager.Instance.EnsureInTransaction(doc)
count = 0
for f in flr:
	try:
		currenthole = hole[count]
		for list in currenthole:
			z = CurveArray()
			for l in list:
				z.Append(l.ToRevitType())
			openings.append(doc.Create.NewOpening(f,z,False))
			doc.Regenerate()
		doc.Delete(oldfls[count].Id)
	except:
		try:
			doc.Delete(f.Id)
		except:
			pass
		msg.append(True)
	count += 1
if len(msg) > 0:
	if len(msg) == 1:
		rampword = " Ramp"
	else:
		rampword = " Ramps"
	msg = "Failed to Convert " + str(len(msg)) + rampword
	TaskDialog.Show(title, msg)
if len(hole) == 0 or len(flr) == 0:
	TaskDialog.Show(title, "Failed to Convert Ramp")
TransactionManager.Instance.TransactionTaskDone()

OUT = flr,openings
# ----------------------------------------
debug_python = Custom[Debug Python]()  # package Synthesize toolkit; Debug Python
