# Dynamo graph Reference.Auto Name Clean or Check.dyn (Dynamo 2.13.1.3887)
# author: karam@aecedx.com
# packages: Synthesize toolkit 12.5.1

# group: Input
n01_select_all_named_references = BoolSelector(false)  # "01.Select All Named References"; graph input
n02_clean_the_names_of_selected = BoolSelector(false)  # "02.Clean the Names of Selected References"; graph input

join = List.Join(list0=n01_select_all_named_references, list1=n02_clean_the_names_of_selected)
allTrue = List.AllTrue(list=join)
code_block = CodeBlock { null; }
element_types = ElementTypes("ReferencePlane")
all_elements_of_type = ElementsOfType(element_type=element_types)
code_block_2 = CodeBlock { "Name"; }
getParameterValueByName = Element.GetParameterValueByName(element=all_elements_of_type, parameterName=code_block_2)
code_block_3 = CodeBlock { ""; }
eq = getParameterValueByName == code_block_3
filterByBoolMask = List.FilterByBoolMask(list=all_elements_of_type, mask=eq)
code_block_4 = CodeBlock { null; false; }
scopeIf = Custom[CW.ScopeIf+](VARtest=n01_select_all_named_references, VARtrue=filterByBoolMask.out, VARfalse=code_block_4.out0)  # package Synthesize toolkit; A (hopefully) more robust implementation of ScopeIf. Tests a single boolean and returns a value accordingly.
flatten = List.Flatten(list=scopeIf)
scopeIf_2 = Custom[CW.ScopeIf+](VARtest=allTrue, VARtrue=code_block, VARfalse=flatten)
hot_select_in_revit = Custom[HOT.Select in Revit](VARElement=scopeIf_2)  # package Synthesize toolkit; Select Elements in Revit
count = List.Count(list=filterByBoolMask.out)
code_block_5 = CodeBlock { "All Cleaned"; }
code_block_6 = CodeBlock { null; false; }
scopeIf_3 = Custom[CW.ScopeIf+](VARtest=allTrue, VARtrue=flatten, VARfalse=code_block_6.out0)
getRevitSelection = Custom[ST.Tool.GetRevitSelection]()  # package Synthesize toolkit; Get the selection from the Revit UI, use boolean action to refresh when selection must be updated
flatten_2 = List.Flatten(list=getRevitSelection)
code_block_7 = CodeBlock { "ReferencePlane"; }
filterByString = Custom[ST.List.FilterByString](VARlist=flatten_2, VARString=code_block_7)  # package Synthesize toolkit; Filter a list by a string match
scopeIf_4 = Custom[CW.ScopeIf+](VARtest=n02_clean_the_names_of_selected, VARtrue=filterByString.VARMatch, VARfalse=code_block_4.out0)
clean = List.Clean(list=scopeIf_4, preserveIndices=code_block_4.out1)
scopeIf_5 = Custom[CW.ScopeIf+](VARtest=allTrue, VARtrue=code_block_6.out0, VARfalse=clean)
create = List.Create(item0=scopeIf_3, item1=scopeIf_5)
clean_2 = List.Clean(list=create, preserveIndices=code_block_6.out1)
flatten_3 = List.Flatten(list=clean_2)
scopeIf_6 = Custom[CW.ScopeIf+](VARtest=n02_clean_the_names_of_selected, VARtrue=code_block_2, VARfalse=code_block_4.out0)
clean_3 = List.Clean(list=scopeIf_6, preserveIndices=code_block_4.out1)
scopeIf_7 = Custom[CW.ScopeIf+](VARtest=allTrue, VARtrue=code_block_6.out0, VARfalse=clean_3)
turnIntoList = Custom[CW.TurnIntoList](VARunknownItem=scopeIf_7)  # package Synthesize toolkit; Turns an element (or a nested list) into a flat list
clean_4 = List.Clean(list=turnIntoList, preserveIndices=code_block_6.out1)
scopeIf_8 = Custom[CW.ScopeIf+](VARtest=allTrue, VARtrue=code_block_2, VARfalse=code_block_6.out0)
turnIntoList_2 = Custom[CW.TurnIntoList](VARunknownItem=scopeIf_8)
clean_5 = List.Clean(list=turnIntoList_2, preserveIndices=code_block_6.out1)
create_2 = List.Create(item0=clean_4, item1=clean_5)
clean_6 = List.Clean(list=create_2, preserveIndices=code_block_6.out1)
flatten_4 = List.Flatten(list=clean_6)
scopeIf_9 = Custom[CW.ScopeIf+](VARtest=allTrue, VARtrue=code_block_3, VARfalse=code_block_6.out0)
turnIntoList_3 = Custom[CW.TurnIntoList](VARunknownItem=scopeIf_9)
clean_7 = List.Clean(list=turnIntoList_3, preserveIndices=code_block_6.out1)
scopeIf_10 = Custom[CW.ScopeIf+](VARtest=n02_clean_the_names_of_selected, VARtrue=code_block_3, VARfalse=code_block_4.out0)
clean_8 = List.Clean(list=scopeIf_10, preserveIndices=code_block_4.out1)
scopeIf_11 = Custom[CW.ScopeIf+](VARtest=allTrue, VARtrue=code_block_6.out0, VARfalse=clean_8)
turnIntoList_4 = Custom[CW.TurnIntoList](VARunknownItem=scopeIf_11)
clean_9 = List.Clean(list=turnIntoList_4, preserveIndices=code_block_6.out1)
create_3 = List.Create(item0=clean_7, item1=clean_9)
clean_10 = List.Clean(list=create_3, preserveIndices=code_block_6.out1)
flatten_5 = List.Flatten(list=clean_10)
setParameterByName = Element.SetParameterByName(element=flatten_3, parameterName=flatten_4, value=flatten_5, lacing=Longest)
count_2 = List.Count(list=setParameterByName)
scopeIf_12 = Custom[CW.ScopeIf+](VARtest=allTrue, VARtrue=code_block_5, VARfalse=count_2)
notes = StringInput("""-Activating Both, "Select All Named References" and "Clean the Names of Selected References" will perform a full clean up to all of the References in the Project.

-If you want to clean up custom references, you can select them manually and "Clean the Names of Selected References".

-You can also Select All Named References while having Clean then References of Selected References Deactivated, then Deselect the references you want to keep their names manually, and check "Select All Nanmed References" to False, then Run having "Clean the Names of Selected References" on.

-To Check the Existed References Names, Just Play without activating any inputs.

-Karam Baki""")  # "03.Notes"; graph input
code_block_8 = CodeBlock { "[0-9]+"; }
filterByBoolMask_2 = List.FilterByBoolMask(list=getParameterValueByName, mask=eq)
bk_natural_sort_list_of_strings = Custom[BK.Natural Sort List of Strings](VARlistOfStrings=filterByBoolMask_2.out)  # package Synthesize toolkit
scopeIf_13 = Custom[CW.ScopeIf+](VARtest=allTrue, VARtrue=code_block_5, VARfalse=bk_natural_sort_list_of_strings)
findRegularExpression = Custom[CW.String.FindRegularExpression](VARRegEx=code_block_8, VARstr=scopeIf_13)  # package Synthesize toolkit; Returns all occurences of a regular expression within a string (or list of strings). The syntax for regular expressions is explained at http://ironpython-test.readthedocs.org/en/latest/howto/regex.html
flatten_6 = List.Flatten(list=findRegularExpression)
toNumber = String.ToNumber(string=flatten_6)
uniqueItems = List.UniqueItems(list=toNumber)
sort = List.Sort(list=uniqueItems)

# group: Input
n01_number_of_all_references = Watch(count)  # "01.Number of All References Points"; graph output
n02_number_of_all_cleaned = Watch(scopeIf_12)  # "02.Number of All Cleaned References"; graph output
n03_all_existed_references_names = Watch(sort)  # "03.All Existed References' Names"; graph output

debug_python = Custom[Debug Python]()  # package Synthesize toolkit; Debug Python
