# Dynamo graph Reference.Auto Name Sequence.dyn (Dynamo 2.13.1.3887)
# author: karam@aecedx.com
# packages: Synthesize toolkit 12.5.1

# group: Input
name_references_by_sequence = BoolSelector(true)
n01_select_reference_planes = DSModelElementsSelection()  # "01.Select Reference Planes"; nothing selected; graph input
n03_automatic_reference_number = BoolSelector(true)  # "03.Automatic Reference Number Detection ? (False for Custom)"; graph input
n04_custom_number_sequence_start = DoubleInput(1)  # "04.Custom Number Sequence Start"; graph input
n02_alphabetical_letter_sequence = StringInput("A")  # "02.Alphabetical Letter Sequence Start (Can be Empty) ?"; graph input

flatten = List.Flatten(list=n01_select_reference_planes)
code_block = CodeBlock { "ReferencePlane"; }
byClassName = Custom[SP.Filter.ByClassName](VARobject=flatten, VARclassName=code_block)  # package Synthesize toolkit; Filters a list of objects by the object's class name. Note that Dynamo elements belong to different classes than their Revit counterparts. Use the Object.Class node to check an object's class.
code_block_2 = CodeBlock { null; }
scopeIf = Custom[CW.ScopeIf+](VARtest=name_references_by_sequence, VARtrue=byClassName.VARin, VARfalse=code_block_2)  # package Synthesize toolkit; A (hopefully) more robust implementation of ScopeIf. Tests a single boolean and returns a value accordingly.
turnIntoList = Custom[CW.TurnIntoList](VARunknownItem=scopeIf)  # package Synthesize toolkit; Turns an element (or a nested list) into a flat list
code_block_3 = CodeBlock { false; }
clean = List.Clean(list=turnIntoList, preserveIndices=code_block_3)
flatten_2 = List.Flatten(list=clean)
code_block_4 = CodeBlock { "Name"; ""; }
scopeIf_2 = Custom[CW.ScopeIf+](VARtest=name_references_by_sequence, VARtrue=code_block_4.out0, VARfalse=code_block_2)
turnIntoList_2 = Custom[CW.TurnIntoList](VARunknownItem=scopeIf_2)
clean_2 = List.Clean(list=turnIntoList_2, preserveIndices=code_block_3)
flatten_3 = List.Flatten(list=clean_2)
code_block_5 = CodeBlock { 0.0001; }
count = List.Count(list=scopeIf)
sequence = Sequence(start=code_block_5, amount=count, step=code_block_5, lacing=Longest)
string_from_object = FromObject(obj=sequence)
scopeIf_3 = Custom[CW.ScopeIf+](VARtest=name_references_by_sequence, VARtrue=string_from_object, VARfalse=code_block_2)
clean_3 = List.Clean(list=scopeIf_3, preserveIndices=code_block_3)
setParameterByName = Element.SetParameterByName(element=flatten_2, parameterName=flatten_3, value=clean_3, lacing=Longest)
passthrough = Custom[CW.Passthrough](VARpassThrough=scopeIf, VARwaitFor=setParameterByName)  # package Synthesize toolkit; Forces a sequential order of execution. The node wired into the output of the Passthrough node will be executed *after* the node wired into the waitFor input (e.g. important for some Revit operations). The value of the passThrough input will be passed on to the node wired into the output port of the Passthrough node.
turnIntoList_3 = Custom[CW.TurnIntoList](VARunknownItem=passthrough)
clean_4 = List.Clean(list=turnIntoList_3, preserveIndices=code_block_3)
passthrough_2 = Custom[CW.Passthrough](VARpassThrough=code_block_4.out0, VARwaitFor=setParameterByName)
code_block_6 = CodeBlock { "[0-9]+"; }
element_types = ElementTypes("ReferencePlane")
all_elements_of_type = ElementsOfType(element_type=element_types)
code_block_7 = CodeBlock { "Name"; }
getParameterValueByName = Element.GetParameterValueByName(element=all_elements_of_type, parameterName=code_block_7)
code_block_8 = CodeBlock { ""; }
eq = getParameterValueByName == code_block_8
filterByBoolMask = List.FilterByBoolMask(list=getParameterValueByName, mask=eq)
findRegularExpression = Custom[CW.String.FindRegularExpression](VARRegEx=code_block_6, VARstr=filterByBoolMask.out)  # package Synthesize toolkit; Returns all occurences of a regular expression within a string (or list of strings). The syntax for regular expressions is explained at http://ironpython-test.readthedocs.org/en/latest/howto/regex.html
flatten_4 = List.Flatten(list=findRegularExpression)
toNumber = String.ToNumber(string=flatten_4)
uniqueItems = List.UniqueItems(list=toNumber)
sort = List.Sort(list=uniqueItems)
list_lastitem_fixer = Custom[List.LastItem Fixer](VARlist=sort)  # package Synthesize toolkit; List.LastItem Fixer
code_block_9 = CodeBlock { 1; }
add = list_lastitem_fixer + code_block_9
isNull = Object.IsNull(object=add)
code_block_10 = CodeBlock { 1; }
scopeIf_4 = Custom[CW.ScopeIf+](VARtest=isNull, VARtrue=code_block_10, VARfalse=add)
scopeIf_5 = Custom[CW.ScopeIf+](VARtest=n03_automatic_reference_number, VARtrue=scopeIf_4, VARfalse=n04_custom_number_sequence_start)
code_block_11 = CodeBlock { 1; }
sequence_2 = Sequence(start=scopeIf_5, amount=count, step=code_block_11, lacing=Longest)
string_from_object_2 = FromObject(obj=sequence_2)
join = String.Join(separator=code_block_4.out1, string0=n02_alphabetical_letter_sequence)  # unwired: string1
map = List.Map(list=string_from_object_2, f_x=join)
trimWhitespace = String.TrimWhitespace()  # unwired: string
map_2 = List.Map(list=map, f_x=trimWhitespace)
passthrough_3 = Custom[CW.Passthrough](VARpassThrough=map_2, VARwaitFor=setParameterByName)
turnIntoList_4 = Custom[CW.TurnIntoList](VARunknownItem=passthrough_3)
clean_5 = List.Clean(list=turnIntoList_4, preserveIndices=code_block_3)
setParameterByName_2 = Element.SetParameterByName(element=clean_4, parameterName=passthrough_2, value=clean_5)
count_2 = List.Count(list=setParameterByName_2)
lastItem = List.LastItem(list=passthrough_3)
code_block_12 = CodeBlock { "Inactive"; }
scopeIf_6 = Custom[CW.ScopeIf+](VARtest=name_references_by_sequence, VARtrue=lastItem, VARfalse=code_block_12)

# group: Report
n01_last_reference_name = Watch(scopeIf_6)  # "01.Last Reference Name"; graph output

debug_python = Custom[Debug Python]()  # package Synthesize toolkit; Debug Python
