# Dynamo graph Reference.Ref Planes Create By Lines.dyn (Dynamo 2.13.1.3887)
# author: karam@aecedx.com
# packages: Synthesize toolkit 12.5.1

# group: Input
n07_create_selection_filter = BoolSelector(true)  # "07.Create Selection Filter ?"; graph input
n08_filter_name_to_create = StringInput("Dynamo Generated Reference Planes")  # "08.Filter Name to Create"; graph input
n09_overwrite_existing_filter = BoolSelector(false)  # "09.Overwrite Existing Filter ? (False for Adding Elements)"; graph input
n01_select_lines_to_convert_to = DSModelElementsSelection()  # "01.Select Lines to Convert to References"; nothing selected; graph input
n02_detail_level_for_families = DetailLevel("Coarse")  # "02.Detail Level For Families"; graph input
n03_name_references_by_sequence = BoolSelector(false)  # "03.Name References By Sequence"; graph input
n05_automatic_reference_number = BoolSelector(true)  # "05.Automatic Reference Number Detection ? (False for Custom)"; graph input
n06_custom_number_sequence_start = DoubleInput(1)  # "06.Custom Number Sequence Start"; graph input
n04_alphabetical_letter_sequence = StringInput("A")  # "04.Alphabetical Letter Sequence Start (Can be Empty) ?"; graph input

referencePlanesByModelElementsorAdaptive = Custom[ReferencePlanesByModelElementsorAdaptiveFamily](VARelements=n01_select_lines_to_convert_to, VARDetailLevelForAdaptiveFamilies=n02_detail_level_for_families)  # package Synthesize toolkit; ReferencePlanesByModelElementsorAdaptiveFamily
flatten = List.Flatten(list=referencePlanesByModelElementsorAdaptive)
generate_selection_filter = Custom[Generate Selection Filter](VARCreateSelectionFilter=n07_create_selection_filter, VARFilterNametoCreate=n08_filter_name_to_create, VAROverwriteExistingFilter=n09_overwrite_existing_filter, VARElements=flatten)  # package Synthesize toolkit; Generate Selection FIlter
flatten_2 = List.Flatten(list=flatten)
code_block = CodeBlock { null; }
scopeIf = Custom[CW.ScopeIf+](VARtest=n03_name_references_by_sequence, VARtrue=flatten_2, VARfalse=code_block)  # package Synthesize toolkit; A (hopefully) more robust implementation of ScopeIf. Tests a single boolean and returns a value accordingly.
turnIntoList = Custom[CW.TurnIntoList](VARunknownItem=scopeIf)  # package Synthesize toolkit; Turns an element (or a nested list) into a flat list
code_block_2 = CodeBlock { false; }
clean = List.Clean(list=turnIntoList, preserveIndices=code_block_2)
flatten_3 = List.Flatten(list=clean)
code_block_3 = CodeBlock { "Name"; ""; }
scopeIf_2 = Custom[CW.ScopeIf+](VARtest=n03_name_references_by_sequence, VARtrue=code_block_3.out0, VARfalse=code_block)
turnIntoList_2 = Custom[CW.TurnIntoList](VARunknownItem=scopeIf_2)
clean_2 = List.Clean(list=turnIntoList_2, preserveIndices=code_block_2)
flatten_4 = List.Flatten(list=clean_2)
code_block_4 = CodeBlock { 0.0001; }
count = List.Count(list=scopeIf)
sequence = Sequence(start=code_block_4, amount=count, step=code_block_4, lacing=Longest)
string_from_object = FromObject(obj=sequence)
scopeIf_3 = Custom[CW.ScopeIf+](VARtest=n03_name_references_by_sequence, VARtrue=string_from_object, VARfalse=code_block)
clean_3 = List.Clean(list=scopeIf_3, preserveIndices=code_block_2)
setParameterByName = Element.SetParameterByName(element=flatten_3, parameterName=flatten_4, value=clean_3, lacing=Longest)
passthrough = Custom[CW.Passthrough](VARpassThrough=scopeIf, VARwaitFor=setParameterByName)  # package Synthesize toolkit; Forces a sequential order of execution. The node wired into the output of the Passthrough node will be executed *after* the node wired into the waitFor input (e.g. important for some Revit operations). The value of the passThrough input will be passed on to the node wired into the output port of the Passthrough node.
turnIntoList_3 = Custom[CW.TurnIntoList](VARunknownItem=passthrough)
clean_4 = List.Clean(list=turnIntoList_3, preserveIndices=code_block_2)
passthrough_2 = Custom[CW.Passthrough](VARpassThrough=code_block_3.out0, VARwaitFor=setParameterByName)
code_block_5 = CodeBlock { "[0-9]+"; }
element_types = ElementTypes("ReferencePlane")
all_elements_of_type = ElementsOfType(element_type=element_types)
code_block_6 = CodeBlock { "Name"; }
getParameterValueByName = Element.GetParameterValueByName(element=all_elements_of_type, parameterName=code_block_6)
code_block_7 = CodeBlock { ""; }
eq = getParameterValueByName == code_block_7
filterByBoolMask = List.FilterByBoolMask(list=getParameterValueByName, mask=eq)
findRegularExpression = Custom[CW.String.FindRegularExpression](VARRegEx=code_block_5, VARstr=filterByBoolMask.out)  # package Synthesize toolkit; Returns all occurences of a regular expression within a string (or list of strings). The syntax for regular expressions is explained at http://ironpython-test.readthedocs.org/en/latest/howto/regex.html
flatten_5 = List.Flatten(list=findRegularExpression)
code_block_8 = CodeBlock { false; }
clean_5 = List.Clean(list=flatten_5, preserveIndices=code_block_8)
toNumber = String.ToNumber(string=clean_5)
uniqueItems = List.UniqueItems(list=toNumber)
sort = List.Sort(list=uniqueItems)
list_lastitem_fixer = Custom[List.LastItem Fixer](VARlist=sort)  # package Synthesize toolkit; List.LastItem Fixer
code_block_9 = CodeBlock { 1; }
add = list_lastitem_fixer + code_block_9
isNull = Object.IsNull(object=add)
code_block_10 = CodeBlock { 1; }
scopeIf_4 = Custom[CW.ScopeIf+](VARtest=isNull, VARtrue=code_block_10, VARfalse=add)
scopeIf_5 = Custom[CW.ScopeIf+](VARtest=n05_automatic_reference_number, VARtrue=scopeIf_4, VARfalse=n06_custom_number_sequence_start)
code_block_11 = CodeBlock { 1; }
sequence_2 = Sequence(start=scopeIf_5, amount=count, step=code_block_11, lacing=Longest)
string_from_object_2 = FromObject(obj=sequence_2)
join = String.Join(separator=code_block_3.out1, string0=n04_alphabetical_letter_sequence)  # unwired: string1
map = List.Map(list=string_from_object_2, f_x=join)
trimWhitespace = String.TrimWhitespace()  # unwired: string
map_2 = List.Map(list=map, f_x=trimWhitespace)
passthrough_3 = Custom[CW.Passthrough](VARpassThrough=map_2, VARwaitFor=setParameterByName)
turnIntoList_4 = Custom[CW.TurnIntoList](VARunknownItem=passthrough_3)
clean_6 = List.Clean(list=turnIntoList_4, preserveIndices=code_block_2)
setParameterByName_2 = Element.SetParameterByName(element=clean_4, parameterName=passthrough_2, value=clean_6)
count_2 = List.Count(list=setParameterByName_2)
count_3 = List.Count(list=flatten)
lastItem = List.LastItem(list=passthrough_3)
code_block_12 = CodeBlock { "Inactive"; }
scopeIf_6 = Custom[CW.ScopeIf+](VARtest=n03_name_references_by_sequence, VARtrue=lastItem, VARfalse=code_block_12)

# group: Report
n01_number_of_references_planes = Watch(count_3)  # "01.Number of References Planes Created"; graph output
n02_last_reference_name = Watch(scopeIf_6)  # "02.Last Reference Name"; graph output

debug_python_no_message = Custom[Debug Python No Message]()  # package Synthesize toolkit; Debug Python
