# Dynamo graph Roofs.Create By Floors.dyn (Dynamo 2.13.1.3887)
# author: karam@aecedx.com
# packages: Synthesize toolkit 12.5.1

# group: Input
n01_select_floors = DSModelElementsSelection()  # "01.Select Floors"; nothing selected; graph input
n04_roof_type_name_to_use = StringInput("Generic Roof - 300mm")  # "04.Roof Type Name to Use ?"; graph input
fix_factor_depends_of_project = DoubleInput(1000)  # "Fix Factor (Depends of Project Units, 1 For meters for example, and 100 for Centimeters)"
n02_boundary_offset = DoubleInput(0)  # "02.Boundary Offset"; graph input
n05_create_selection_filter = BoolSelector(true)  # "05.Create Selection Filter ?"; graph input
n06_filter_name_to_create = StringInput("Dynamo Roofs Converted")  # "06.Filter Name to Create"; graph input
n07_overwrite_existing_filter = BoolSelector(false)  # "07.Overwrite Existing Filter ? (False for Adding Elements)"; graph input
n03_height_offset = DoubleInput(-0.3)  # "03.Height Offset"; graph input

string_from_object = FromObject(obj=n01_select_floors)
code_block = CodeBlock { "Floor"; }
eq = string_from_object == code_block
filterByBoolMask = List.FilterByBoolMask(list=n01_select_floors, mask=eq)
elementSketch = Custom[SP.Collector.ElementSketch](VARelement=filterByBoolMask.in)  # package Synthesize toolkit; Get the actual sketch lines of a sketch based element (floor, ceiling, modified wall, etc.) . You can optionally fetch the matching model curves, however this might prove comptationally heavy on larger data sets.
flatten = List.Flatten(list=elementSketch.VARcurves@L2)
code_block_2 = CodeBlock { "Level"; "Height Offset From Level"; }
getParameterValueByName = Element.GetParameterValueByName(element=filterByBoolMask.in, parameterName=code_block_2.out0)
plane = Custom[CW.Level.Plane](VARlevel=getParameterValueByName)  # package Synthesize toolkit; Retrieves the plane of a given level
pullOntoPlane = Curve.PullOntoPlane(curve=flatten, plane=plane, lacing=Longest)
ZAxis = Vector.ZAxis()
getParameterValueByName_2 = Element.GetParameterValueByName(element=filterByBoolMask.in, parameterName=code_block_2.out1)
translate = Geometry.Translate(geometry=pullOntoPlane, direction=ZAxis, distance=getParameterValueByName_2, lacing=Longest)
as_polycurve_bycurves = Custom[AS.[&] PolyCurve.ByCurves](VARcurves=translate)  # package Synthesize toolkit; Create polycurves from an unordered list of curves.
flatten_2 = List.Flatten(list=as_polycurve_bycurves.VARpolyCurve)
byName = RoofType.ByName(name=n04_roof_type_name_to_use)
code_block_3 = CodeBlock { true; 0.001; false; "null"; }
create_roofs_by_boundary_lines = Custom[Create Roofs By Boundary Lines (Smart)](VARRoofsBoundariesPolycurves=flatten_2, VARRoofType=byName, VARUseAllLevelsIgnoresLevelsSelectionFilter=code_block_3.out0, VARRounding=code_block_3.out1, VARSetOffsetParameter=code_block_3.out0, VARFixFactorDependsofProjectUnits1Formetersforexampleand100forCentimeters=fix_factor_depends_of_project, VARLevelsSelectionFiltertoRead=code_block_3.out3, VARRoundingFix=code_block_3.out2, VAROffset=n02_boundary_offset)  # package Synthesize toolkit; Create Floors By Boundary Lines (Smart)

# group: Report
n01_number_of_roofs_created = Watch(create_roofs_by_boundary_lines.VARNumberofRoofsCreated)  # "01.Number of Roofs Created"; graph output

generate_selection_filter = Custom[Generate Selection Filter](VARCreateSelectionFilter=n05_create_selection_filter, VARFilterNametoCreate=n06_filter_name_to_create, VAROverwriteExistingFilter=n07_overwrite_existing_filter, VARElements=create_roofs_by_boundary_lines.VARRoofs)  # package Synthesize toolkit; Generate Selection FIlter
code_block_4 = CodeBlock { "Base Offset From Level"; }
add = n03_height_offset + getParameterValueByName_2
setParameterByName = Element.SetParameterByName(element=create_roofs_by_boundary_lines.VARRoofs, parameterName=code_block_4, value=add, lacing=Longest)
debug_python = Custom[Debug Python]()  # package Synthesize toolkit; Debug Python
