# Dynamo graph Roofs.Create By Subregions.dyn (Dynamo 2.13.1.3887)
# author: karam@aecedx.com
# packages: Synthesize toolkit 12.5.1

# group: Input
n05_create_selection_filter = BoolSelector(true)  # "05.Create Selection Filter ?"; graph input
n06_selection_filter_name = StringInput("Dynamo Roofs By Subregions")  # "06.Selection Filter Name"; graph input
n07_overwrite_existing_filter = BoolSelector(false)  # "07.Overwrite Existing Filter ? (False for Adding Elements)"; graph input
n01_select_subregions = DSModelElementsSelection()  # "01.Select Subregions"; nothing selected; graph input
n03_roof_type = StringInput("Generic Roof - 300mm")  # "03.Roof Type"; graph input
n02_roof_level = Levels()  # "02.Roof Level"; nothing selected; graph input
n04_points_tollerance = DoubleInput(0.001)  # "04.Points Tollerance"; graph input

code_block = CodeBlock { "Topography"; }
byClassName = Custom[SP.Filter.ByClassName](VARobject=n01_select_subregions, VARclassName=code_block)  # package Synthesize toolkit; Filters a list of objects by the object's class name. Note that Dynamo elements belong to different classes than their Revit counterparts. Use the Object.Class node to check an object's class.
is_topography_subregion = Custom[Is Topography Subregion](VARTopography=byClassName.VARin@L1)  # package Synthesize toolkit; Is Topography Subregion
filterByBoolMask = List.FilterByBoolMask(list=byClassName.VARin, mask=is_topography_subregion)
code_block_2 = CodeBlock { true; }
polySurface = Custom[ZK.Topography.PolySurface](VARTopography=filterByBoolMask.in@L1, VAROnlyCurves=code_block_2)  # package Synthesize toolkit; Convert topography element to polysurface
tunnel_mode_creates_floors_pads = BoolSelector(false)  # "Tunnel Mode ? (Creates Floors & Pads & Contour Lines)"
python_script = Python(IN[0]=polySurface.VARPolyCurves, IN[1]=polySurface.VARLineStyleIds, IN[2]=tunnel_mode_creates_floors_pads)  # IronPython2
# ---------- python_script.python (98 lines) ----------
import clr
clr.AddReference('ProtoGeometry')
from Autodesk.DesignScript import Geometry as dg
clr.AddReference('RevitNodes')
import Revit
clr.AddReference('RevitAPI')
from Autodesk.Revit.DB import *
clr.AddReference('RevitServices')
from RevitServices.Persistence import DocumentManager
from RevitServices.Transactions import TransactionManager
clr.ImportExtensions(Revit.GeometryConversion)

class WarnSwallowSimple(IFailuresPreprocessor):
	def PreprocessFailures(self, failuresAccessor):
		failuresAccessor.DeleteAllWarnings()
		return FailureProcessingResult.Continue

def tolist(obj1):
	if hasattr(obj1,'__iter__'): return obj1
	else: return [obj1]

def flatten(x):
    result = []
    for el in x:
        if hasattr(el, "__iter__") and not isinstance(el, basestring):
            result.extend(flatten(el))
        else:
            result.append(el)
    return result

def GraphStylesbyLineStylesIds(doc,LineStylesIds):
	def NewUniqueOP(doc,LineStylesIds):
		namedstyles = []
		cats = doc.Settings.Categories
		linescat = cats.get_Item(BuiltInCategory.OST_Lines)
		styles =  linescat.SubCategories
		for style in styles:
			namedstyles.append([style.Name,style])
		LineStyles = []
		for l in LineStylesIds:
			l = doc.GetElement(l)
			wantedsub = []
			for n in namedstyles:
				if "Dynamo " + l.Name == n[0]:
					wantedsub = n[1]
					break
			existedcat = l.GraphicsStyleCategory
			linename = existedcat.Name
			linewight = existedcat.GetLineWeight(GraphicsStyleType.Projection)
			linepattern = existedcat.GetLinePatternId(GraphicsStyleType.Projection)
			linecolor = existedcat.LineColor
			if wantedsub == []:
				wantedsub = cats.NewSubcategory(linescat,"Dynamo " + linename)
			wantedsub.SetLineWeight(linewight,GraphicsStyleType.Projection)
			wantedsub.SetLinePatternId(linepattern,GraphicsStyleType.Projection)
			wantedsub.LineColor = linecolor
			wantedstyle = wantedsub.GetGraphicsStyle(GraphicsStyleType.Projection)
			LineStyles.append(wantedstyle)
		return LineStyles
	uniqueIds = set(LineStylesIds)
	NewUniqueLineStyles = NewUniqueOP(doc,uniqueIds)
	MappedStyles = []
	for LineStyleId in LineStylesIds:
		count = 0
		for unique in uniqueIds:
			if unique == LineStyleId:
				MappedStyles.append(NewUniqueLineStyles[count])
			count += 1
	return MappedStyles

polycurves = UnwrapElement(flatten(tolist(IN[0])))
LineStylesIds = UnwrapElement(flatten(tolist(IN[1])))
proceed = IN[2]

if proceed:
	doc = DocumentManager.Instance.CurrentDBDocument
	LineStyles = GraphStylesbyLineStylesIds(doc,LineStylesIds)
	result = []
	TransactionManager.Instance.EnsureInTransaction(doc)
	count = 0
	for poly in polycurves:
		exploded = dg.Geometry.Explode(poly)
		plane = SketchPlane.Create(doc,dg.PolyCurve.BasePlane(poly).ToPlane())
		for ex in exploded:
			try:
				modline = UnwrapElement(Revit.Elements.ModelCurve.ByCurve(ex))
			except:
				try:
					modline = doc.Create.NewModelCurve(ex.ToRevitType(),plane)
				except:
					continue
			modline.LineStyle = LineStyles[count]
			result.append(modline)
		count += 1
	TransactionManager.Instance.TransactionTaskDone()
	OUT = result
else:
	OUT = []
# ----------------------------------------
element_types = ElementTypes("RoofType")
all_elements_of_type = ElementsOfType(element_type=element_types)
name = Element.Name(element=all_elements_of_type)
eq = n03_roof_type == name
filterByBoolMask_2 = List.FilterByBoolMask(list=all_elements_of_type, mask=eq)
firstItem = List.FirstItem(list=filterByBoolMask_2.in)
passthrough = Custom[CW.Passthrough](VARpassThrough=tunnel_mode_creates_floors_pads, VARwaitFor=python_script)  # package Synthesize toolkit; Forces a sequential order of execution. The node wired into the output of the Passthrough node will be executed *after* the node wired into the waitFor input (e.g. important for some Revit operations). The value of the passThrough input will be passed on to the node wired into the output port of the Passthrough node.
floors_by_subregion = Custom[Floors By Subregion](VARSubregions=n01_select_subregions, VARFloorType=firstItem, VARCreatePads=passthrough, VARFloorLevel=n02_roof_level, VARTollerance=n04_points_tollerance)  # package Synthesize toolkit; Floors By Subregion
create = List.Create(item0=python_script, item1=floors_by_subregion)
flatten = List.Flatten(list=create)
generate_selection_filter = Custom[Generate Selection Filter](VARCreateSelectionFilter=n05_create_selection_filter, VARFilterNametoCreate=n06_selection_filter_name, VAROverwriteExistingFilter=n07_overwrite_existing_filter, VARElements=flatten)  # package Synthesize toolkit; Generate Selection FIlter
debug_python_no_message = Custom[Debug Python No Message]()  # package Synthesize toolkit; Debug Python
isNull = Object.IsNull(object=firstItem)
code_block_3 = CodeBlock { "Roof Type Not Found!"; null; }
scopeIf = Custom[CW.ScopeIf+](VARtest=isNull, VARtrue=code_block_3.out0, VARfalse=code_block_3.out1)  # package Synthesize toolkit; A (hopefully) more robust implementation of ScopeIf. Tests a single boolean and returns a value accordingly.
alert_popup = Custom[Alert Popup](VARMessage=scopeIf)  # package Synthesize toolkit; Popup a message dialog in Revit
