# Dynamo graph Roofs.Fascias By Model Lines.dyn (Dynamo 2.13.1.3887)
# author: karam@aecedx.com
# packages: Synthesize toolkit 12.5.1

# group: Input
n01_select_model_lines = DSModelElementsSelection()  # "01.Select Model Lines"; nothing selected; graph input
n02_fascia_type = StringInput("Fascia")  # "02.Fascia Type"; graph input
n03_horizontal_flip = BoolSelector(false)  # "03.Horizontal Flip ?"; graph input
n05_vertical_flip = BoolSelector(false)  # "05.Vertical Flip ?"; graph input
n04_horizontal_offset = DoubleInput(0)  # "04.Horizontal Offset"; graph input
n06_vertical_offset = DoubleInput(0)  # "06.Vertical Offset"; graph input
angle = DoubleInput(0)  # "07.Angle"; graph input

code_block = CodeBlock { "ModelCurve"; }
byClassName = Custom[SP.Filter.ByClassName](VARobject=n01_select_model_lines, VARclassName=code_block)  # package Synthesize toolkit; Filters a list of objects by the object's class name. Note that Dynamo elements belong to different classes than their Revit counterparts. Use the Object.Class node to check an object's class.
curves = Element.Curves(element=byClassName.VARin)
isEmpty = List.IsEmpty(list=curves, lacing=Longest)
filterByBoolMask = List.FilterByBoolMask(list=byClassName.VARin, mask=isEmpty)
flatten = List.Flatten(list=filterByBoolMask.out)
filterByBoolMask_2 = List.FilterByBoolMask(list=curves, mask=isEmpty)
flatten_2 = List.Flatten(list=filterByBoolMask_2.out)
groupModelLines = Custom[GroupModelLines](VARModelLines=flatten, VAREquivalentCurves=flatten_2)  # package Synthesize toolkit; GroupModelLines
element_types = ElementTypes("FasciaType")
all_elements_of_type = ElementsOfType(element_type=element_types)
python_script = Python(IN[0]=all_elements_of_type, IN[1]=n02_fascia_type)  # IronPython2
# ---------- python_script.python (47 lines) ----------
# Enable Python support and load DesignScript library
# IMPORTANT : ALL DYNAMO DESIGN SCRIPT NODES ARE AS (dg)
import clr
clr.AddReference('ProtoGeometry')
from Autodesk.DesignScript import Geometry as dg

# EXTENSION Enable ToDSType
clr.AddReference('RevitNodes')
import Revit
clr.ImportExtensions(Revit.Elements)

# Enable Revit Elements
from Revit.Elements import *

# EXTENSION Enable Geometry Conversion Methods
clr.ImportExtensions(Revit.GeometryConversion)

# Enable Revit API
clr.AddReference('RevitAPI')
from Autodesk.Revit.DB import *

# Enable DocumentManager and TransactionManager
clr.AddReference('RevitServices')
from RevitServices.Persistence import DocumentManager
from RevitServices.Transactions import TransactionManager

# Enable ICollection List Translate
clr.AddReference("System")
import System.Collections.Generic
from System.Collections.Generic import List

dataEnteringNode = IN
# Use UnwrapElement(IN[0]) When Translating From Dynamo to Revit
types = UnwrapElement(IN[0])
wanted = IN[1]
# Choose The Current Document
doc = DocumentManager.Instance.CurrentDBDocument
uidoc = DocumentManager.Instance.CurrentUIApplication.ActiveUIDocument
uiapp = DocumentManager.Instance.CurrentUIApplication
app = uiapp.Application

for t in types:
	if wanted.lower() == t.GetParameters("Type Name")[0].AsString().lower():
		result = t
		break
# Assign your output to the OUT variable.
OUT = result
# ----------------------------------------
python_script_2 = Python(IN[0]=groupModelLines.VARGroupedModelLines, IN[1]=python_script, IN[2]=n03_horizontal_flip, IN[3]=n05_vertical_flip)  # IronPython2
# ---------- python_script_2.python (201 lines) ----------
# Enable Python support and load DesignScript library
# IMPORTANT : ALL DYNAMO DESIGN SCRIPT NODES ARE AS (dg)
import clr
clr.AddReference('ProtoGeometry')
from Autodesk.DesignScript import Geometry as dg

# EXTENSION Enable ToDSType
clr.AddReference('RevitNodes')
import Revit
clr.ImportExtensions(Revit.Elements)

# Enable Revit Elements
from Revit.Elements import *

# EXTENSION Enable Geometry Conversion Methods
clr.ImportExtensions(Revit.GeometryConversion)

# Enable Revit API
clr.AddReference('RevitAPI')
from Autodesk.Revit.DB import *

# Enable DocumentManager and TransactionManager
clr.AddReference('RevitServices')
from RevitServices.Persistence import DocumentManager
from RevitServices.Transactions import TransactionManager

# Enable ICollection List Translate
clr.AddReference("System")
import System.Collections.Generic
from System.Collections.Generic import List

import math

def joincurves(crvs):
	def PointsEqual(pt1, pt2):
		tolerance = 0.00001
		if (math.fabs(pt1.X - pt2.X) < tolerance and
		    math.fabs(pt1.Y - pt2.Y) < tolerance and
		    math.fabs(pt1.Z - pt2.Z) < tolerance):
			return True
		else:
			return False
	crvs = flatten(tolist(crvs))
	crvGroup = [-1 for x in range(len(crvs))]
	crvGroup[0] = 0
	maxGroupNum = 1
	starts = []
	ends = []
	for crv in crvs:
		starts.append(crv.PointAtParameter(0))
		ends.append(crv.PointAtParameter(1))
	for i in range(len(crvs)):
		if (crvGroup[i] == -1):
			crvGroup[i] = i
		for j in range(len(crvs)):
			if (i != j and
				(PointsEqual(starts[i], starts[j]) or
				PointsEqual(starts[i], ends[j]) or
				PointsEqual(ends[i], starts[j]) or
				PointsEqual(ends[i], ends[j]))):
				if (crvGroup[j] == -1):
					crvGroup[j] = crvGroup[i]
				elif (crvGroup[i] != crvGroup[j]):
					oldNum = crvGroup[j]
					for k in range(len(crvs)):
						if (crvGroup[k] == oldNum):
							crvGroup[k] = crvGroup[i]
	groups = []
	excluded = []
	for n in crvGroup:
		innercount = 0
		tmp = []
		for n2 in crvGroup:
			if n == n2 and n2 not in excluded:
				tmp.append(crvs[innercount])
			innercount += 1
		if len(tmp) == 0:
			continue
		try:
			tmp = dg.PolyCurve.ByJoinedCurves(tmp)
			groups.append(tmp)
		except:
			for t in tmp:
				groups.append(t)
		excluded.append(n)
	joinedcurves = groups
	return joinedcurves

def doesinter(a,b,tollerance = 0.05):
	if round(dg.Geometry.DistanceTo(a,b),2) < tollerance:
		return True
	else:
		return False

def tolist(obj1):
	if hasattr(obj1,'__iter__'): return obj1
	else: return [obj1]

def flatten(x):
    result = []
    for el in x:
        if hasattr(el, "__iter__") and not isinstance(el, basestring):
            result.extend(flatten(el))
        else:
            result.append(el)
    return result

class WarnSwallow(IFailuresPreprocessor):
	def PreprocessFailures(self, failuresAccessor):
		fmas = failuresAccessor.GetFailureMessages()
		if len(fmas) == 0:
			self.__warn = []
			return FailureProcessingResult.Continue
		else:
			probs = []
			isgood = True
			for fma in fmas:
				sev = str(fma.GetSeverity())
				fails = list(fma.GetFailingElementIds())
				felems = []
				for f in fails:
					felems.append(doc.GetElement(f))
				if str(sev) == "Warning": 
					failuresAccessor.ResolveFailure(fma)
					failuresAccessor.DeleteWarning(fma)
				else:
					isgood = False
					probs.append(felems) 
				self.__warn = probs
		if isgood:
			return FailureProcessingResult.ProceedWithCommit
		else:
			return FailureProcessingResult.ProceedWithRollBack 

	@property
	def warn(self):
		return(self.__warn)

dataEnteringNode = IN
# Use UnwrapElement(IN[0]) When Translating From Dynamo to Revit
modelLinesGroups = UnwrapElement(tolist(IN[0]))
slabedgetype = UnwrapElement(IN[1])
ishoriflip = IN[2]
isvertiflip = IN[3]

# Choose The Current Document
doc = DocumentManager.Instance.CurrentDBDocument
uidoc = DocumentManager.Instance.CurrentUIApplication.ActiveUIDocument
uiapp = DocumentManager.Instance.CurrentUIApplication
app = uiapp.Application

if int(DocumentManager.Instance.CurrentUIApplication.Application.VersionNumber) < 2021:
	unit_type = UnitType.UT_Length
	formatoptions = doc.GetUnits().GetFormatOptions(unit_type)
	dispunits = formatoptions.DisplayUnits
	factor = UnitUtils.ConvertToInternalUnits(1,dispunits)
else:
	factor = UnitUtils.ConvertToInternalUnits(1,doc.GetUnits().GetFormatOptions(SpecTypeId.Length).GetUnitTypeId())

# Create Empty List
result = []

# Start a Transaction with Current Document (doc)
TransactionManager.Instance.ForceCloseTransaction()
tGroup = TransactionGroup(doc, 'Auto Fascia Create')
tGroup.Start()
slabs = []
newslabs = []
#try:
for modelLinesGroup in modelLinesGroups:
	errors = []
	for modelLine in modelLinesGroup:
		modelLine = Reference(modelLine)
		trans = Transaction(doc, 'Auto Fascia')
		trans.Start()
		warnhandle = WarnSwallow()
		foptions = trans.GetFailureHandlingOptions()
		foptions.SetFailuresPreprocessor(warnhandle)
		foptions.SetClearAfterRollback(True)
		trans.SetFailureHandlingOptions(foptions)
		try:
			slabedge = doc.Create.NewFascia(slabedgetype,modelLine)
		except:
			errors.append(a)
			trans.RollBack()
			continue
		if ishoriflip:
			slabedge.HorizontalFlip()
		if isvertiflip:
			slabedge.VerticalFlip()
		trans.Commit()
		if len(warnhandle.warn) == 0:
			slabs.append(slabedge)
		else:
			errors.append(a)
#except:
#	pass
tGroup.Assimilate()

# Assign your output to the OUT variable.
OUT = slabs
# ----------------------------------------
code_block_2 = CodeBlock { "Horizontal Profile Offset"; "Vertical Profile Offset"; "Angle"; }
setParameterByName = Element.SetParameterByName(element=python_script_2, parameterName=code_block_2.out0, value=n04_horizontal_offset)
setParameterByName_2 = Element.SetParameterByName(element=python_script_2, parameterName=code_block_2.out1, value=n06_vertical_offset)
setParameterByName_3 = Element.SetParameterByName(element=python_script_2, parameterName=code_block_2.out2, value=angle)
debug_python_no_message = Custom[Debug Python No Message]()  # package Synthesize toolkit; Debug Python
