# Dynamo graph Room.3D Room Tags.dyn (Dynamo 2.13.1.3887)
# author: karam@aecedx.com
# packages: Synthesize toolkit 12.5.1

# group: Input
n01_model_text_family = StringInput("Sample Model 3D Room Tags")  # "01.Model Text Family"; graph input
n02_all_rooms_false_if_you_want = BoolSelector(false)  # "02.All Rooms (False If You Want to Filter By Sync Parameter)"; graph input
n03_yes_no_sync_parameter = StringInput("Sync with Dynamo")  # "03.Yes/No Sync Parameter"; graph input
n05_parameter_to_grab_into_text_2 = StringInput("Area")  # "05.Parameter to Grab Into Text 2"; graph input
n06_number_of_digits_for_areas_if = DoubleInput(2)  # "06.Number of Digits for Areas If Used"; graph input
n04_parameter_to_grab_into_text_1 = StringInput("Name")  # "04.Parameter to Grab Into Text 1"; graph input
n09_rotation_angle = IntegerSlider(0, range=0..360 step 1)  # "09.Rotation Angle ?"; graph input
n07_custom_height_false_for_auto = BoolSelector(true)  # "07.Custom Height (False for Auto Calculate, Volumes must be enabled)"; graph input
n08_custom_height = DoubleInput(2)  # "08.Custom Height"; graph input
n10_create_selection_filter = BoolSelector(true)  # "10.Create Selection Filter ?"; graph input
n11_filter_name_to_create = StringInput("Dynamo Room 3D Tags")  # "11.Filter Name to Create"; graph input
n12_overwrite_existing_filter = BoolSelector(false)  # "12.Overwrite Existing Filter ? (False for Adding Elements)"; graph input

byName = FamilyType.ByName(name=n01_model_text_family)
categories = Categories("OST_Rooms")
all_elements_of_category = ElementsOfCategory(Category=categories)
state = Custom[CW.Room.State](VARroom=all_elements_of_category)  # package Synthesize toolkit; Returns the state of a room, i.e. is it placed, unplaced, redundant or not enclosed.
code_block = CodeBlock { "Placed"; }
eq = state == code_block
filterByBoolMask = List.FilterByBoolMask(list=all_elements_of_category, mask=eq)
state_2 = Custom[CW.Room.State](VARroom=filterByBoolMask.in)
code_block_2 = CodeBlock { "Placed"; }
eq_2 = state_2 == code_block_2
filterByBoolMask_2 = List.FilterByBoolMask(list=filterByBoolMask.in, mask=eq_2)
getParameterValueByName = Element.GetParameterValueByName(element=filterByBoolMask_2.in, parameterName=n03_yes_no_sync_parameter)
code_block_3 = CodeBlock { 1; }
eq_3 = getParameterValueByName == code_block_3
filterByBoolMask_3 = List.FilterByBoolMask(list=filterByBoolMask_2.in, mask=eq_3)
scopeIf = Custom[CW.ScopeIf+](VARtest=n02_all_rooms_false_if_you_want, VARtrue=filterByBoolMask_2.in, VARfalse=filterByBoolMask_3.in)  # package Synthesize toolkit; A (hopefully) more robust implementation of ScopeIf. Tests a single boolean and returns a value accordingly.
flatten = List.Flatten(list=scopeIf)
location = Room.Location(room=flatten)
byPoint = FamilyInstance.ByPoint(familyType=byName, point=location)
code_block_4 = CodeBlock { "Height"; "Text 1"; "Text 2"; }
getParameterValueByName_2 = Element.GetParameterValueByName(element=flatten, parameterName=n05_parameter_to_grab_into_text_2)
string_from_object = FromObject(obj=getParameterValueByName_2)
create = List.Create(item0=string_from_object)
flatten_2 = List.Flatten(list=create)
toNumber = String.ToNumber()  # unwired: string
map = List.Map(list=create, f_x=toNumber)
isNull = Object.IsNull(object=map)
flatten_3 = List.Flatten(list=isNull)
filterByBoolMask_4 = List.FilterByBoolMask(list=flatten_2, mask=flatten_3)
create_2 = List.Create(item0=filterByBoolMask_4.out)
toNumber_2 = String.ToNumber()  # unwired: string
map_2 = List.Map(list=create_2, f_x=toNumber_2)
flatten_4 = List.Flatten(list=map_2)
code_block_5 = CodeBlock { "0."; }
code_block_6 = CodeBlock { 1; }
withLeadingZeroes = Custom[CW.List.WithLeadingZeroes](VARnum=code_block_6, VARn=n06_number_of_digits_for_areas_if)  # package Synthesize toolkit; Adds leading zeros to a sequence of numbers
code_block_7 = CodeBlock(a=code_block_5, b=withLeadingZeroes) { a+b; }
toNumber_3 = String.ToNumber(string=code_block_7)
roundToPrecision = Custom[CW.Math.RoundToPrecision](VARdbl=flatten_4, VARprecision=toNumber_3)  # package Synthesize toolkit; Rounds a number to a specified precision
toString = Custom[SP.Number.ToString](VARnum=roundToPrecision, VARdigits=n06_number_of_digits_for_areas_if)  # package Synthesize toolkit; Converts the input number(s) to string. You can optionally limit the number of digits.
create_3 = List.Create(item0=toString)
flatten_5 = List.Flatten(list=create_3)
code_block_8 = CodeBlock { false; }
clean = List.Clean(list=flatten_5, preserveIndices=code_block_8)
flatten_6 = List.Flatten(list=clean)
mergeByBoolMask = Custom[SP.List.MergeByBoolMask](VARIn=filterByBoolMask_4.in, VAROut=flatten_6, VARmask=flatten_3)  # package Synthesize toolkit; Merge two lists by a boolean mask list. The true count in the mask should be the same as the length of the true list and vice versa for the false list.
setParameterByName = Element.SetParameterByName(element=byPoint, parameterName=code_block_4.out2, value=mergeByBoolMask)
getParameterValueByName_3 = Element.GetParameterValueByName(element=flatten, parameterName=n04_parameter_to_grab_into_text_1)
string_from_object_2 = FromObject(obj=getParameterValueByName_3)
create_4 = List.Create(item0=string_from_object_2)
flatten_7 = List.Flatten(list=create_4)
toNumber_4 = String.ToNumber()  # unwired: string
map_3 = List.Map(list=create_4, f_x=toNumber_4)
isNull_2 = Object.IsNull(object=map_3)
flatten_8 = List.Flatten(list=isNull_2)
filterByBoolMask_5 = List.FilterByBoolMask(list=flatten_7, mask=flatten_8)
create_5 = List.Create(item0=filterByBoolMask_5.out)
toNumber_5 = String.ToNumber()  # unwired: string
map_4 = List.Map(list=create_5, f_x=toNumber_5)
flatten_9 = List.Flatten(list=map_4)
code_block_9 = CodeBlock { "0."; }
code_block_10 = CodeBlock { 1; }
withLeadingZeroes_2 = Custom[CW.List.WithLeadingZeroes](VARnum=code_block_10, VARn=n06_number_of_digits_for_areas_if)
code_block_11 = CodeBlock(a=code_block_9, b=withLeadingZeroes_2) { a+b; }
toNumber_6 = String.ToNumber(string=code_block_11)
roundToPrecision_2 = Custom[CW.Math.RoundToPrecision](VARdbl=flatten_9, VARprecision=toNumber_6)
toString_2 = Custom[SP.Number.ToString](VARnum=roundToPrecision_2, VARdigits=n06_number_of_digits_for_areas_if)
create_6 = List.Create(item0=toString_2)
flatten_10 = List.Flatten(list=create_6)
code_block_12 = CodeBlock { false; }
clean_2 = List.Clean(list=flatten_10, preserveIndices=code_block_12)
flatten_11 = List.Flatten(list=clean_2)
mergeByBoolMask_2 = Custom[SP.List.MergeByBoolMask](VARIn=filterByBoolMask_5.in, VAROut=flatten_11, VARmask=flatten_8)
setParameterByName_2 = Element.SetParameterByName(element=setParameterByName, parameterName=code_block_4.out1, value=mergeByBoolMask_2)
setRotation = FamilyInstance.SetRotation(familyInstance=byPoint, degree=n09_rotation_angle)
code_block_13 = CodeBlock { "Area"; "Volume"; }
getParameterValueByName_4 = Element.GetParameterValueByName(element=flatten, parameterName=code_block_13.out1)
getParameterValueByName_5 = Element.GetParameterValueByName(element=flatten, parameterName=code_block_13.out0)
div = getParameterValueByName_4 / getParameterValueByName_5
code_block_14 = CodeBlock { 2; }
div_2 = div / code_block_14
scopeIf_2 = Custom[CW.ScopeIf+](VARtest=n07_custom_height_false_for_auto, VARtrue=n08_custom_height, VARfalse=div_2)
Z = Point.Z(point=location)
add = scopeIf_2 + Z
setParameterByName_3 = Element.SetParameterByName(element=setParameterByName, parameterName=code_block_4.out0, value=add)
count = List.Count(list=location)

# group: Report
n01_number_of_rooms_included = Watch(count)  # "01.Number of Rooms Included"; graph output

scopeIf_3 = Custom[CW.ScopeIf+](VARtest=isNull_2, VARtrue=create_4, VARfalse=map_3)
code_block_15 = CodeBlock { false; }
clean_3 = List.Clean(list=scopeIf_3, preserveIndices=code_block_15)
scopeIf_4 = Custom[CW.ScopeIf+](VARtest=isNull, VARtrue=create, VARfalse=map)
code_block_16 = CodeBlock { false; }
clean_4 = List.Clean(list=scopeIf_4, preserveIndices=code_block_16)
flatten_12 = List.Flatten(list=byPoint)
generate_selection_filter = Custom[Generate Selection Filter](VARCreateSelectionFilter=n10_create_selection_filter, VARFilterNametoCreate=n11_filter_name_to_create, VAROverwriteExistingFilter=n12_overwrite_existing_filter, VARElements=flatten_12)  # package Synthesize toolkit; Generate Selection FIlter
debug_python = Custom[Debug Python]()  # package Synthesize toolkit; Debug Python
