# Dynamo graph Room.Place Family By Rooms.dyn (Dynamo 2.13.1.3887)
# author: karam@aecedx.com
# packages: Synthesize toolkit 12.5.1

# group: Input
n02_all_rooms_false_if_you_want = BoolSelector(true)  # "02.All Rooms (False If You Want to Filter By Sync Parameter)"; graph input
n03_yes_no_sync_parameter = StringInput("Sync with Dynamo")  # "03.Yes/No Sync Parameter"; graph input
n08_offset_from_walls = DoubleInput(-0.5)  # "08.Offset From Walls"; graph input
n01_family_type = FamilyTypes()  # "01.Family Type"; nothing selected; graph input
n06_u_distance = DoubleInput(2)  # "06.U Distance"; graph input
n07_v_distance = DoubleInput(2)  # "07.V Distance"; graph input
n04_method_false_by_room_center = BoolSelector(true)  # "04.Method : False = By Room Center | True = By Room Upper Surface"; graph input
n10_create_selection_filter = BoolSelector(true)  # "10.Create Selection Filter ?"; graph input
n11_filter_name = StringInput("Dynamo Families By Rooms")  # "11.Filter Name"; graph input

python_script = Python(IN[0]=n02_all_rooms_false_if_you_want, IN[1]=n03_yes_no_sync_parameter)  # IronPython2
# ---------- python_script.python (114 lines) ----------
# Enable Python support and load DesignScript library
# IMPORTANT : ALL DYNAMO DESIGN SCRIPT NODES ARE AS (dg)
import clr
clr.AddReference('ProtoGeometry')
from Autodesk.DesignScript import Geometry as dg

# EXTENSION Enable ToDSType
clr.AddReference('RevitNodes')
import Revit
clr.ImportExtensions(Revit.Elements)

# Enable Revit Elements
from Revit.Elements import *

# EXTENSION Enable Geometry Conversion Methods
clr.ImportExtensions(Revit.GeometryConversion)

# Enable Revit API
clr.AddReference('RevitAPI')
from Autodesk.Revit.DB import *

# Enable DocumentManager and TransactionManager
clr.AddReference('RevitServices')
from RevitServices.Persistence import DocumentManager
from RevitServices.Transactions import TransactionManager

# Enable ICollection List Translate
clr.AddReference("System")
import System.Collections.Generic
from System.Collections.Generic import List

def GetCenterOfFaceUV(MyFace):
	CurvePoints_Umin = []
	CurvePoints_Umax = []
	CurvePoints_Vmin = []
	CurvePoints_Vmax = []
	CurvePoints_U = []
	CurvePoints_V = []
	MyEdgeLoops = MyFace.EdgeLoops
	for MyEdgeArray in MyEdgeLoops:
		for MyEdge in MyEdgeArray:
			Tesselated = MyEdge.TessellateOnFace(MyFace)
			for MyUV in Tesselated:
				CurvePoints_U.append(MyUV.U)
				CurvePoints_V.append(MyUV.V)
	CurvePoints_Umin = min(CurvePoints_U)
	CurvePoints_Umax = max(CurvePoints_U)
	CurvePoints_Vmin = min(CurvePoints_V)
	CurvePoints_Vmax = max(CurvePoints_V)
	return UV(CurvePoints_Umax - CurvePoints_Umin, CurvePoints_Vmax - CurvePoints_Vmin)

def flatten(x):
    result = []
    for el in x:
        if hasattr(el, "__iter__") and not isinstance(el, basestring):
            result.extend(flatten(el))
        else:
            result.append(el)
    return result

doc = DocumentManager.Instance.CurrentDBDocument
app = doc.Application

allrooms = IN[0]
syncparam = IN[1]

rooms = FilteredElementCollector(doc).OfCategory(BuiltInCategory.OST_Rooms).ToElements();

acceptedrooms = []
if allrooms == False:
	for room in rooms:
		param = room.LookupParameter(syncparam)
		if param != None:
			if param.AsInteger() == 1:
				acceptedrooms.append(room)
	rooms = acceptedrooms

if len(rooms) > 0:
	base_surfaces = []
	other_surfaces =  []
	
	shellslist = []
	for room in rooms:
		shellslist.append(room.ClosedShell)
	shellslist = flatten(shellslist)
	for shell in shellslist:
		try:
			faces = shell.Faces
			xyzpoints = []
			tocompare = []
			for face in faces:
				bounding_box = face.GetBoundingBox()
				minp = face.Evaluate(bounding_box.Min)
				maxp = face.Evaluate(bounding_box.Max)
				midpoint = Line.CreateBound(minp,maxp).Evaluate(0.5,True)
				xyzpoints.append(midpoint.Z)
				tocompare.append(face)
			minxyz = min(xyzpoints)
			count = 0
			tmp_other_surfaces = []
			for xyzpoint in xyzpoints:
				if minxyz == xyzpoint:
					base_surfaces.append(tocompare[count].ToProtoType()[0])
				else:
					tmp_other_surfaces.append(tocompare[count])	
				count += 1
			#other_surfaces.append(tmp_other_surfaces)
		except:
			pass
		
	#Assign your output to the OUT variable.
	OUT = base_surfaces
else:
	OUT = "Nothing to do"
# ----------------------------------------
abs = Math.Abs(number=n08_offset_from_walls)
metersInput = Custom[MetersInput](VARInput=abs)  # package Synthesize toolkit; MetersInput
code_block = CodeBlock { true; }
k_paneling_framing_only = Custom[K-Paneling Framing Only](VARSuraces=python_script, VARFrameWidth=metersInput, VAROnlySubtractedSurfaces=code_block)  # package Synthesize toolkit; Create Frames By Surfaces
flatten = List.Flatten(list=k_paneling_framing_only.VARFrameSolids)
metersInput_2 = Custom[MetersInput](VARInput=n06_u_distance)
metersInput_3 = Custom[MetersInput](VARInput=n07_v_distance)
n09_try_rhomboid_experimental = BoolSelector(false)  # "09.Try Rhomboid (Experimental)"; graph input
n05_by_room_center_default_height = DoubleInput(1.5)  # "05.By Room Center: Default Height"; graph input
metersInput_4 = Custom[MetersInput](VARInput=n05_by_room_center_default_height)
place_family_by_surfaces = Custom[Place Family By Surfaces](VARSurfaces=python_script, VARTrimmedSurfaces=flatten, VARFamilyType=n01_family_type, VARUdistance=metersInput_2, VARVdistance=metersInput_3, VARTryRhomboid=n09_try_rhomboid_experimental, VARTrimOffset=metersInput, VARUpperMode=n04_method_false_by_room_center, VARMidModeHeight=metersInput_4, VARCreateSelectionFilter=n10_create_selection_filter, VARSelectionFilterName=n11_filter_name)  # package Synthesize toolkit; Place Family By Room
