# Dynamo graph Room.Rooms Re-Number By Intersect Order of Spline.dyn (Dynamo 2.13.1.3887)
# author: karam@aecedx.com
# packages: Synthesize toolkit 12.5.1

# group: Input
n01_select_reference_line = DSModelElementSelection()  # "01.Select Reference Line"; nothing selected; graph input
excluded_rooms_by_name_seperate = StringInput("Circulation")  # "Excluded Rooms by Name (Seperate by Comma , )"
n02_room_parameter_to_work_on = StringInput("Number")  # "02.Room Parameter to work on"; graph input
n03_prefix_to_add_can_be_empty = StringInput("LV-")  # "03.Prefix to Add (Can be Empty) ?"; graph input
n04_number_sequence_start = DoubleInput(101)  # "04.Number Sequence Start"; graph input
n07_remove_0_s = BoolSelector(false)  # "07.Remove 0's"; graph input
n06_no_of_digits = DoubleSlider(3, range=1..3 step 1)  # "06.No.of Digits"; graph input
n05_suffix_to_add_can_be_empty = StringInput("")  # "05.Suffix to Add (Can be Empty) ?"; graph input
n08_reverse_naming = BoolSelector(false)  # "08.Reverse Naming"; graph input

curve = CurveElement.Curve(curveElement=n01_select_reference_line)
code_block = CodeBlock { true; }
lb_lunchbox_room_element = Custom[LB.LunchBox Room Element Collector](VARToggle=code_block)  # package Synthesize toolkit; Collects rooms from the Revit document
code_block_2 = CodeBlock { ","; }
split = String.Split(string=excluded_rooms_by_name_seperate, separator0=code_block_2)
trimWhitespace = String.TrimWhitespace(string=split)
contains = List.Contains(list=lb_lunchbox_room_element.VARName@L1, item=trimWhitespace, lacing=CrossProduct)
anyTrue = Custom[CW.List.AnyTrue](VARseq=contains)  # package Synthesize toolkit; Returns true if any item in a list of booleans is true.
filterByBoolMask = List.FilterByBoolMask(list=lb_lunchbox_room_element.VARElement, mask=anyTrue)
python_all_elements_in_active = Custom[Python All Elements In Active View]()  # package Synthesize toolkit; Python All Elements In Active View
code_block_3 = CodeBlock { false; }
clean = List.Clean(list=python_all_elements_in_active, preserveIndices=code_block_3)
flatten = List.Flatten(list=clean)
python_filter_list_from_another = Custom[Python Filter List From Another List](VARItemsToFilter=filterByBoolMask.out, VARAllItemsToFilterFrom=flatten)  # package Synthesize toolkit; Find Intersections In Lists
finishBoundary = Room.FinishBoundary(room=python_filter_list_from_another)
as_polycurve_bycurves = Custom[AS.[&] PolyCurve.ByCurves](VARcurves=finishBoundary@L3)  # package Synthesize toolkit; Create polycurves from an unordered list of curves.
flatten_2 = List.Flatten(list=as_polycurve_bycurves.VARpolyCurve@L3)
firstItem = List.FirstItem(list=flatten_2)
basePlane = PolyCurve.BasePlane(polyCurve=firstItem)
pullOntoPlane = Curve.PullOntoPlane(curve=curve, plane=basePlane)
code_block_4 = CodeBlock { 0..1..#400; }
pointAtParameter = Curve.PointAtParameter(curve=pullOntoPlane, param=code_block_4, lacing=CrossProduct)
splitByPoints = Curve.SplitByPoints(curve=pullOntoPlane, points=pointAtParameter)
endPoint = Curve.EndPoint(curve=splitByPoints)
flatten_3 = List.Flatten(list=endPoint)
pullOntoPlane_2 = Curve.PullOntoPlane(curve=flatten_2@L2, plane=basePlane)
byPatch = Surface.ByPatch(closedCurve=pullOntoPlane_2)
surface_importer = Custom[Surface Importer](VARSurfaces=byPatch)  # package Synthesize toolkit; Surface Importer Node
surfaces = PolySurface.Surfaces(polySurface=surface_importer)
flatten_4 = List.Flatten(list=surfaces)
flatten_5 = List.Flatten(list=flatten_4)
doesIntersect = Geometry.DoesIntersect(geometry=flatten_5)  # unwired: other
map = List.Map(list=flatten_3, f_x=doesIntersect)
filterByBoolMask_2 = List.FilterByBoolMask(list=python_filter_list_from_another)  # unwired: mask
map_2 = List.Map(list=map, f_x=filterByBoolMask_2.in)
flatten_6 = List.Flatten(list=map_2)
uniqueItems = List.UniqueItems(list=flatten_6)
count = List.Count(list=uniqueItems)
sequenced_string_numbers = Custom[Sequenced String Numbers Generate](VARCountofElements=count, VARPrefixtoAddCanbeEmpty=n03_prefix_to_add_can_be_empty, VARNumberSequenceStart=n04_number_sequence_start, VARRemove0s=n07_remove_0_s, VAR=n06_no_of_digits, VARSuffixtoAddCanbeEmpty=n05_suffix_to_add_can_be_empty, VARReverseNaming=n08_reverse_naming)  # package Synthesize toolkit; Sequenced String Numbers Generate
setParameterByName = Element.SetParameterByName(element=uniqueItems, parameterName=n02_room_parameter_to_work_on, value=sequenced_string_numbers.VARValues)

# group: Report
n01_number_of_selected_elements = Watch(sequenced_string_numbers.VARNumberofSelectedElements)  # "01.Number of Selected Elements"; graph output
report = Watch(sequenced_string_numbers.VARReport)  # "02.Report"; graph output

debug_python = Custom[Debug Python]()  # package Synthesize toolkit; Debug Python
