# Dynamo graph Room.Rooms Separators By Curves.dyn (Dynamo 2.13.1.3887)
# author: karam@aecedx.com
# packages: Synthesize toolkit 12.5.1

# group: Input
n03_create_selection_filter = BoolSelector(true)  # "03.Create Selection Filter ?"; graph input
n04_filter_name_to_create = StringInput("Dynamo Room Separators")  # "04.Filter Name to Create"; graph input
n05_overwrite_existing_filter = BoolSelector(false)  # "05.Overwrite Existing Filter"; graph input
n01_select_curves = DSModelElementsSelection()  # "01.Select Curves"; nothing selected; graph input
n02_delete_old_curves = BoolSelector(true)  # "02.Delete Old Curves ?"; graph input

curves = Element.Curves(element=n01_select_curves)
isEmpty = List.IsEmpty(list=curves, lacing=Longest)
filterByBoolMask = List.FilterByBoolMask(list=curves, mask=isEmpty)
isClosed = Curve.IsClosed(curve=filterByBoolMask.out)
filterByBoolMask_2 = List.FilterByBoolMask(list=filterByBoolMask.out, mask=isClosed)
flatten = List.Flatten(list=filterByBoolMask_2.in)
code_block = CodeBlock { 1; }
chop = List.Chop(list=flatten, lengths=code_block)
curves_offset_to_revit = Custom[Curves Offset To Revit Compatibility](VARCurves=chop)  # package Synthesize toolkit; Curves Offset To Revit Compatibility
flatten_2 = List.Flatten(list=curves_offset_to_revit.VARRevitCurves)
python_script = Python(IN[0]=flatten_2)  # IronPython2
# ---------- python_script.python (41 lines) ----------
import clr
clr.AddReference('RevitAPI')
from Autodesk.Revit.DB import *

clr.AddReference("RevitNodes")
import Revit
clr.ImportExtensions(Revit.GeometryConversion)

clr.AddReference("RevitServices")
import RevitServices
from RevitServices.Persistence import DocumentManager
from RevitServices.Transactions import TransactionManager

def toList(input):
	if isinstance(input,list) == False:
		return [input]
	else:
		return input

doc = DocumentManager.Instance.CurrentDBDocument
curves = UnwrapElement(toList(IN[0]))

if len(curves) != 0:
	TransactionManager.Instance.EnsureInTransaction(doc)
	curvearray = CurveArray()
	for curve in curves:
		try:
			curvearray.Append(curve)
		except:
			pass
	doccreation = doc.Create
	separatorarray = doccreation.NewRoomBoundaryLines(doc.ActiveView.SketchPlane, curvearray, doc.ActiveView)
	TransactionManager.Instance.TransactionTaskDone()
	
	elementlist = list()
	for item in separatorarray:
		elementlist.append(item)
	
	OUT = elementlist
else:
	OUT = "Nothing to Do"
# ----------------------------------------
filterByBoolMask_3 = List.FilterByBoolMask(list=n01_select_curves, mask=isEmpty)
anyFalse = Custom[CW.List.AnyFalse](VARseq=isClosed)  # package Synthesize toolkit; Returns true if any item in a list of booleans is false.
filterByBoolMask_4 = List.FilterByBoolMask(list=filterByBoolMask_3.out, mask=anyFalse)
python_script_2 = Python(IN[0]=filterByBoolMask_4.in)  # IronPython2
# ---------- python_script_2.python (41 lines) ----------
import clr
clr.AddReference('RevitAPI')
from Autodesk.Revit.DB import *

clr.AddReference("RevitNodes")
import Revit
clr.ImportExtensions(Revit.GeometryConversion)

clr.AddReference("RevitServices")
import RevitServices
from RevitServices.Persistence import DocumentManager
from RevitServices.Transactions import TransactionManager

def toList(input):
	if isinstance(input,list) == False:
		return [input]
	else:
		return input

doc = DocumentManager.Instance.CurrentDBDocument
curves = UnwrapElement(toList(IN[0]))

if len(curves) != 0:
	TransactionManager.Instance.EnsureInTransaction(doc)
	curvearray = CurveArray()
	for curve in curves:
		try:
			curvearray.Append(curve.GeometryCurve)
		except:
			pass
	doccreation = doc.Create
	separatorarray = doccreation.NewRoomBoundaryLines(doc.ActiveView.SketchPlane, curvearray, doc.ActiveView)
	TransactionManager.Instance.TransactionTaskDone()
	
	elementlist = list()
	for item in separatorarray:
		elementlist.append(item)
	
	OUT = elementlist
else:
	OUT = "Nothing to Do"
# ----------------------------------------
create = List.Create(item0=python_script, item1=python_script_2)
code_block_2 = CodeBlock { false; }
clean = List.Clean(list=create, preserveIndices=code_block_2)
flatten_3 = List.Flatten(list=clean)
generate_selection_filter = Custom[Generate Selection Filter](VARCreateSelectionFilter=n03_create_selection_filter, VARFilterNametoCreate=n04_filter_name_to_create, VAROverwriteExistingFilter=n05_overwrite_existing_filter, VARElements=flatten_3)  # package Synthesize toolkit; Generate Selection FIlter
debug_python_no_message = Custom[Debug Python No Message]()  # package Synthesize toolkit; Debug Python
empty = List.Empty()
scopeIf = Custom[CW.ScopeIf+](VARtest=n02_delete_old_curves, VARtrue=filterByBoolMask_3.out, VARfalse=empty)  # package Synthesize toolkit; A (hopefully) more robust implementation of ScopeIf. Tests a single boolean and returns a value accordingly.
eraser = Custom[ST.Tool.Eraser](VARList=scopeIf)  # package Synthesize toolkit; Try to delete any element from project
