# Dynamo graph Sandbox.K-Paneling Data Process.dyn (Dynamo 2.13.1.3887)
# author: karam@aecedx.com
# packages: Synthesize toolkit 12.5.1

# group: Input
n01_k_paneling_data_path = Directory("C:\Users\Karam\Desktop")  # "01.K-Paneling Data Path"; graph input
n02_preview_geometry = BoolSelector(true)  # "02.Preview Geometry"; graph input

k_paneling_data_import = Custom[K-Paneling Data Import](VARDirectoryPath=n01_k_paneling_data_path)  # package Synthesize toolkit; K-Paneling Data Import
k_paneling_sandbox = Custom[K-Paneling Sandbox](VARSurfaces=k_paneling_data_import.VARSurfaces, VARBorderDepth=k_paneling_data_import.VARBorderDepth, VARBorderWidth=k_paneling_data_import.VARBorderWidth, VARDistanceU=k_paneling_data_import.VARDistanceU, VARDistanaceV=k_paneling_data_import.VARDistanaceV, VARMethodU=k_paneling_data_import.VARMethodU, VARMethodV=k_paneling_data_import.VARMethodV, VARUWidth=k_paneling_data_import.VARUWidth, VARUDepth=k_paneling_data_import.VARUDepth, VARVWidth=k_paneling_data_import.VARVWidth, VARVDepth=k_paneling_data_import.VARVDepth, VARExtendFix=k_paneling_data_import.VARExtendFix, VARPrecision=k_paneling_data_import.VARPrecision, VARPanelThickness=k_paneling_data_import.VARPanelThickness, VARCreatePanels=k_paneling_data_import.VARCreatePanels, VARSafeThickenFactor=k_paneling_data_import.VARSafeThickenFactor, VARCustomGridU=k_paneling_data_import.VARCustomGridU, VARCustomGridV=k_paneling_data_import.VARCustomGridV, VARCustomGridW=k_paneling_data_import.VARCustomGridW, VARWWidth=k_paneling_data_import.VARWWidth, VARWDepth=k_paneling_data_import.VARWDepth, VARRemoveSameGridConflict=k_paneling_data_import.VARRemoveSameGridConflict, VARUOffset=k_paneling_data_import.VARUOffset, VARVOffset=k_paneling_data_import.VARVOffset, VARWOffset=k_paneling_data_import.VARWOffset, VARPanelOffset=k_paneling_data_import.VARPanelOffset, VARBorderOffset=k_paneling_data_import.VARBorderOffset, lacing=Longest)  # package Synthesize toolkit; K-Paneling
code_block = CodeBlock { 3; }
normalizeDepth = List.NormalizeDepth(list=k_paneling_sandbox, rank=code_block)

# group: Colors
glazed_border_preview_color = ColorPalette({R: 240, G: 248, B: 255, A: 255})
glazed_mullions_preview_color = ColorPalette({R: 240, G: 248, B: 255, A: 255})
glazed_panels_preview_color = ColorPalette({R: 150, G: 170, B: 200, A: 150})
solid_border_preview_color = ColorPalette({R: 0, G: 0, B: 0, A: 255})
solid_separator_preview_color = ColorPalette({R: 0, G: 0, B: 0, A: 255})
solid_panels_preview_color = ColorPalette({R: 240, G: 248, B: 255, A: 255})

# group: Toggle Run Script
toggle_run_script_change_to_true = BoolSelector(false)  # "Toggle Run Script (Change to True or False then Hit Run)"

k_paneling_external_process = Custom[K-Paneling External Process Function](VARGeometryLists=normalizeDepth, VARFiles=k_paneling_data_import.VARFiles, VARIsSolid=k_paneling_data_import.VARIsSolid, VARPreviewGeometry=n02_preview_geometry, VARGlazedBorderPreviewColor=glazed_border_preview_color, VARGlazedMullionsPreviewColor=glazed_mullions_preview_color, VARGlazedPanelsPreviewColor=glazed_panels_preview_color, VARSolidBorderPreviewColor=solid_border_preview_color, VARSolidSeparatorPreviewColor=solid_separator_preview_color, VARSolidPanelsPreviewColor=solid_panels_preview_color, VARToggleRunScriptChangetoTrueorFalsethenHitRun=toggle_run_script_change_to_true)  # package Synthesize toolkit; K-Paneling External Process Function
