# Dynamo graph Selection.IDs Text file Load.dyn (Dynamo 2.13.1.3887)
# author: karam@aecedx.com
# packages: Synthesize toolkit 12.5.1

n01_filter_name_to_create = StringInput("ID Selection filter")  # "01.Filter name to create"; graph input

# group: Input
n02_ids_text_file_path_to_load = Filename("..\..\..\..\..\..\..\..\Desktop\Dynamo IDs.csv")  # "02.IDs Text file path to load"; graph input
n03_clean_the_csv_from_unused_ids = BoolSelector(false)  # "03.Clean the CSV from Unused IDs"; graph input

fromPath = FileObject(path=n02_ids_text_file_path_to_load)  # "File.FromPath"
importCSV = Data.ImportCSV(filePath=fromPath)
firstItem = List.FirstItem(list=importCSV@L2)
al_current_document = Custom[AL.Current Document]()  # package Synthesize toolkit; Retrieves Current Document
al_id_to_element = Custom[AL.Id to Element](VARDoc=al_current_document)  # package Synthesize toolkit; Selects elements in a model from id input (ElementId, string, integer or GUID); unwired: VARIds
map = List.Map(list=firstItem, f_x=al_id_to_element)
flatten = List.Flatten(list=map)
code_block = CodeBlock { null; }
code_block_2 = CodeBlock { "            Invalid Id             "; }
eq = _ == code_block_2  # unwired: x
replaceByCondition = Replace(item=flatten, replaceWith=code_block, condition=eq)
isNull = Object.IsNull(object=replaceByCondition)
filterByBoolMask = List.FilterByBoolMask(list=importCSV, mask=isNull)
flatten_2 = List.Flatten(list=filterByBoolMask.out)
al_current_document_2 = Custom[AL.Current Document]()
al_id_to_element_2 = Custom[AL.Id to Element](VARIds=flatten_2, VARDoc=al_current_document_2)
byElements = Custom[CW.SelectionSet.ByElements](VARName=n01_filter_name_to_create, VARelements=al_id_to_element_2)  # package Synthesize toolkit; Creates a selection set of the given elements. Note that if a selection set of the given name already exists in the model, its contents will be replaced. Also, if the selection set is already applied as a view filter, the view filter will have to be manually updated in the visibility / graphic overrides. DO ***NOT*** USE IN AUTOMATIC MODE!
code_block_3 = CodeBlock { null; false; }
scopeIf = Custom[CW.ScopeIf+](VARtest=n03_clean_the_csv_from_unused_ids, VARtrue=n02_ids_text_file_path_to_load, VARfalse=code_block_3.out0)  # package Synthesize toolkit; A (hopefully) more robust implementation of ScopeIf. Tests a single boolean and returns a value accordingly.
create = List.Create(item0=scopeIf)
isNull_2 = Object.IsNull(object=replaceByCondition)
filterByBoolMask_2 = List.FilterByBoolMask(list=importCSV, mask=isNull_2)
clean = List.Clean(list=filterByBoolMask_2.out)
exportCSV = Data.ExportCSV(data=clean)  # unwired: filePath
map_2 = List.Map(list=create, f_x=exportCSV)
debug_python = Custom[Debug Python]()  # package Synthesize toolkit; Debug Python
