# Dynamo graph Selection.IDs Text file Save.dyn (Dynamo 2.13.1.3887)
# author: karam@aecedx.com
# packages: Synthesize toolkit 12.5.1

# group: Input
write_to_csv = BoolSelector(true)
n01_ids_csv_file_path_to_save = StringInput("C:\Users\karam\Desktop\Dynamo IDs.csv")  # "01.IDs CSV file path to save"; graph input
n02_overwrite_existing_excel_file = BoolSelector(false)  # "02.Overwrite Existing Excel File"; graph input

code_block = CodeBlock { null; false; }
scopeIf = Custom[CW.ScopeIf+](VARtest=write_to_csv, VARtrue=n01_ids_csv_file_path_to_save, VARfalse=code_block.out0)  # package Synthesize toolkit; A (hopefully) more robust implementation of ScopeIf. Tests a single boolean and returns a value accordingly.
create = List.Create(item0=scopeIf)
code_block_2 = CodeBlock { null; false; }
fromPath = FileObject(path=n01_ids_csv_file_path_to_save)  # "File.FromPath"
flatten = List.Flatten(list=fromPath)
importCSV = Data.ImportCSV()  # unwired: filePath
map = List.Map(list=flatten, f_x=importCSV)
flatten_2 = List.Flatten(list=map@L2)
code_block_3 = CodeBlock { false; }
clean = List.Clean(list=flatten_2, preserveIndices=code_block_3)
hot_get_revit_selection = Custom[HOT.Get Revit Selection]()  # package Synthesize toolkit
id = Element.Id(element=hot_get_revit_selection)
string_from_object = FromObject(obj=id)
join = List.Join(list0=clean, list1=string_from_object)
uniqueItems = List.UniqueItems(list=join)
code_block_4 = CodeBlock { "ProtoCore.DSASM.StackValue"; }
eq = uniqueItems == code_block_4
filterByBoolMask = List.FilterByBoolMask(list=uniqueItems, mask=eq)
code_block_5 = CodeBlock { false; }
clean_2 = List.Clean(list=filterByBoolMask.out, preserveIndices=code_block_5)
flatten_3 = List.Flatten(list=clean_2)
uniqueItems_2 = List.UniqueItems(list=flatten_3)
scopeIf_2 = Custom[CW.ScopeIf+](VARtest=write_to_csv, VARtrue=uniqueItems_2, VARfalse=code_block.out0)
clean_3 = List.Clean(list=scopeIf_2, preserveIndices=code_block.out1)
scopeIf_3 = Custom[CW.ScopeIf+](VARtest=n02_overwrite_existing_excel_file, VARtrue=code_block_2.out0, VARfalse=clean_3)
scopeIf_4 = Custom[CW.ScopeIf+](VARtest=n02_overwrite_existing_excel_file, VARtrue=string_from_object, VARfalse=code_block_2.out0)
create_2 = List.Create(item0=scopeIf_3, item1=scopeIf_4)
clean_4 = List.Clean(list=create_2, preserveIndices=code_block_2.out1)
flatten_4 = List.Flatten(list=clean_4)
passthrough = Custom[CW.Passthrough](VARpassThrough=flatten_4, VARwaitFor=clean)  # package Synthesize toolkit; Forces a sequential order of execution. The node wired into the output of the Passthrough node will be executed *after* the node wired into the waitFor input (e.g. important for some Revit operations). The value of the passThrough input will be passed on to the node wired into the output port of the Passthrough node.
exportCSV = Data.ExportCSV(data=passthrough)  # unwired: filePath
map_2 = List.Map(list=create, f_x=exportCSV)
debug_python = Custom[Debug Python]()  # package Synthesize toolkit; Debug Python
