# Dynamo graph Sheets.Auto Uppercase.dyn (Dynamo 2.13.1.3887)
# author: karam@aecedx.com
# packages: Synthesize toolkit 12.5.1

categories = Categories("OST_Sheets")
all_elements_of_category = ElementsOfCategory(Category=categories)
code_block = CodeBlock { "Sheet Name"; }
sheetName = Sheet.SheetName(sheet=all_elements_of_category)
toUpper = String.ToUpper(string=sheetName)
setParameterByName = Element.SetParameterByName(element=all_elements_of_category, parameterName=code_block, value=toUpper)
code_block_2 = CodeBlock { "Sheet Number"; }
sheetNumber = Sheet.SheetNumber(sheet=all_elements_of_category)
toUpper_2 = String.ToUpper(string=sheetNumber)
setParameterByName_2 = Element.SetParameterByName(element=setParameterByName, parameterName=code_block_2, value=toUpper_2)
count = List.Count(list=setParameterByName_2)

# group: Report
n01_number_of_sheets_converted_to = Watch(count)  # "01.Number of Sheets Converted to Upper Case"; graph output

debug_python = Custom[Debug Python]()  # package Synthesize toolkit; Debug Python
