# Dynamo graph Stairs.K-Fill Bellow Stair - Automatic.dyn (Dynamo 2.13.1.3887)
# author: karam@aecedx.com
# packages: Synthesize toolkit 12.5.1

debug_python = Custom[Debug Python]()  # package Synthesize toolkit; Debug Python

# group: Input
n01_select_stairs = DSModelElementsSelection()  # "01.Select Stairs"; nothing selected; graph input
n02_ignore_surfaces_with_area = DoubleInput(0)  # "02.Ignore Surfaces With Area Less Than"; graph input
n03_family_name = StringInput("Dynamo Stairs K-Fill")  # "03.Family Name"; graph input
category = Categories("OST_GenericModel")  # "04.Category"; graph input
n05_family_template_of_the_above = Filename("..\..\..\..\..\..\..\..\..\..\ProgramData\Autodesk\RVT 2020\Family Templates\English\Metric Generic Model.rft")  # "05.Family Template of The Above Category"; graph input

code_block = CodeBlock { "Stairs"; }
filterByString = Custom[ST.List.FilterByString](VARlist=n01_select_stairs, VARString=code_block)  # package Synthesize toolkit; Filter a list by a string match
element_geometry_fixer = Custom[Element.Geometry Fixer](VARElement=filterByString.VARMatch@L1)  # package Synthesize toolkit; Element.Geometry Fixer
flatten = List.Flatten(list=element_geometry_fixer@L2)
remove_duplicated_solids = Custom[Remove Duplicated Solids](VARGeometry=flatten@L2)  # package Synthesize toolkit; Remove Duplicated Solids
get_stairs_bottom_surfaces = Custom[Get Stairs Bottom Surfaces](VARSolidGeometry=remove_duplicated_solids@L2, VARIgnoreSurfacesWithAreaLessThan=n02_ignore_surfaces_with_area)  # package Synthesize toolkit; Get Stairs Bottom Surfaces
perimeterCurves = Surface.PerimeterCurves(surface=get_stairs_bottom_surfaces.VARSurfaces)
as_polycurve_bycurves = Custom[AS.[&] PolyCurve.ByCurves](VARcurves=perimeterCurves)  # package Synthesize toolkit; Create polycurves from an unordered list of curves.
flatten_2 = List.Flatten(list=as_polycurve_bycurves.VARpolyCurve@L3)
ZAxis = Vector.ZAxis()
code_block_2 = CodeBlock(a=get_stairs_bottom_surfaces.VARHeight) { a*-2; }
curve_extrudeassolid_fixer = Custom[Curve.ExtrudeAsSolid Fixer](VARcurve=flatten_2, VARdirection=ZAxis, VARdistance=code_block_2)  # package Synthesize toolkit; Curve.ExtrudeAsSolid Fixer
code_block_3 = CodeBlock { false; }
clean = List.Clean(list=curve_extrudeassolid_fixer, preserveIndices=code_block_3)
code_block_4 = CodeBlock { "Base Level"; "Base Offset"; }
getParameterValueByName = Element.GetParameterValueByName(element=filterByString.VARMatch, parameterName=code_block_4.out0)
plane = Custom[CW.Level.Plane](VARlevel=getParameterValueByName)  # package Synthesize toolkit; Retrieves the plane of a given level
ZAxis_2 = Vector.ZAxis()
getParameterValueByName_2 = Element.GetParameterValueByName(element=filterByString.VARMatch, parameterName=code_block_4.out1)
translate = Geometry.Translate(geometry=plane, direction=ZAxis_2, distance=getParameterValueByName_2)
split = Geometry.Split(geometry=clean, other=translate, lacing=Longest)
count = List.Count(list=split@@L2)
code_block_5 = CodeBlock { 1; }
eq = count == code_block_5
filterByBoolMask = List.FilterByBoolMask(list=split, mask=eq)
boundingBox = Geometry.BoundingBox(geometry=filterByBoolMask.out)
minPoint = BoundingBox.MinPoint(boundingBox=boundingBox)
Z = Point.Z(point=minPoint)
maximumItem = List.MaximumItem(list=Z)
eq_2 = Z == maximumItem
filterByBoolMask_2 = List.FilterByBoolMask(list=filterByBoolMask.out, mask=eq_2)
flatten_3 = List.Flatten(list=filterByBoolMask_2.in@L3)
byUnion = Custom[CW.Solid.ByUnion+](VARsolids=flatten_3@L2)  # package Synthesize toolkit; The OOTB node Solid.ByUnion occasionally fails when trying to merge solids with almost adjacent faces. This node will return the minimum amount of joined solids possible in such cases instead of returning null.
flatten_4 = List.Flatten(list=byUnion)
join_adjacent_solids = Custom[Join Adjacent Solids](VARSolids=flatten_4)  # package Synthesize toolkit; Join Adjacent Surfaces
code_block_6 = CodeBlock { false; }
getMaterials = Element.GetMaterials(element=filterByString.VARMatch)
name = Material.Name(material=getMaterials)
flatten_5 = List.Flatten(list=name)
firstItem = List.FirstItem(list=flatten_5)
count_2 = List.Count(list=join_adjacent_solids)
cycle = List.Cycle(list=firstItem, amount=count_2)
k_family_insert = Custom[K-Family Insert](VARGeometryorSAT=join_adjacent_solids@L1, VAROneFamily=code_block_6, VARFamilyName=n03_family_name, VARFamilyCategory=category, VARFamilyTemplatePath=n05_family_template_of_the_above, VARMaterialName=cycle@L1)  # package Synthesize toolkit; K-Family Insert
