# Dynamo graph Structural.Copping Auto Cope By Interference Check.dyn (Dynamo 2.13.1.3887)
# author: karam@aecedx.com
# packages: Synthesize toolkit 12.5.1

# group: Input
n02_inverse_coping_ctrl_z_might = BoolSelector(false)  # "02.Inverse Coping (Ctrl + Z Might Be Required to Undo the Unwanted Cope)"; graph input
n03_length_rule_apply = BoolSelector(true)  # "03.Length Rule Apply ?"; graph input
n01_interference_file = Filename("No file selected.")  # "01.Interference File"; graph input
n04_parameter_to_apply_rule_by_1 = IntegerSlider(1, range=1..2 step 1)  # "04.Parameter to Apply Rule By (1 = Length | 2 = Cut Length)"; graph input

k_interference_check = Custom[K-Interference Check](VARReport=n01_interference_file)  # package Synthesize toolkit; K-Interference Check
code_block = CodeBlock { 1; }
eq = n04_parameter_to_apply_rule_by_1 == code_block
code_block_2 = CodeBlock { "Length"; "Cut Length"; }
scopeIf = Custom[CW.ScopeIf+](VARtest=eq, VARtrue=code_block_2.out0, VARfalse=code_block_2.out1)  # package Synthesize toolkit; A (hopefully) more robust implementation of ScopeIf. Tests a single boolean and returns a value accordingly.
getParameterValueByName = Element.GetParameterValueByName(parameterName=scopeIf)  # unwired: element
sortByFunction = List.SortByFunction(list=k_interference_check.VARAffectedElements@L2, sortFunction=getParameterValueByName)
code_block_3 = CodeBlock { false; }
clean = List.Clean(list=sortByFunction, preserveIndices=code_block_3)
reverse = List.Reverse(list=clean@L2)
scopeIf_2 = Custom[CW.ScopeIf+](VARtest=n03_length_rule_apply, VARtrue=reverse, VARfalse=k_interference_check.VARAffectedElements)
reverse_2 = List.Reverse(list=scopeIf_2@L2)
scopeIf_3 = Custom[CW.ScopeIf+](VARtest=n02_inverse_coping_ctrl_z_might, VARtrue=reverse_2, VARfalse=scopeIf_2)
lastItem = List.LastItem(list=scopeIf_3@L2)
firstItem = List.FirstItem(list=scopeIf_3@L2)
addCoping = Custom[CW.FamilyInstance.AddCoping](VARfamilyInstance=lastItem, VARcuttingElement=firstItem)  # package Synthesize toolkit; Adds a coping (cut) to a steel beam
debug_python = Custom[Debug Python]()  # package Synthesize toolkit; Debug Python
