# Dynamo graph Structural.Copping Auto Cope By Selection.dyn (Dynamo 2.13.1.3887)
# author: karam@aecedx.com
# packages: Synthesize toolkit 12.5.1

# group: Input
n05_remove_all_existed_copping = BoolSelector(false)  # "05.Remove All Existed Copping Warnings ?"; graph input
n02_inverse_coping_ctrl_z_might = BoolSelector(false)  # "02.Inverse Coping (Ctrl + Z Might Be Required to Undo the Unwanted Cope)"; graph input
n03_length_rule_apply = BoolSelector(true)  # "03.Length Rule Apply ?"; graph input
n01_select_elements = DSModelElementsSelection()  # "01.Select Elements"; nothing selected; graph input
n04_parameter_to_apply_rule_by_1 = IntegerSlider(1, range=1..2 step 1)  # "04.Parameter to Apply Rule By (1 = Length | 2 = Cut Length)"; graph input

code_block = CodeBlock { "framing"; }
byClassName = Custom[SP.Filter.ByClassName](VARobject=n01_select_elements, VARclassName=code_block)  # package Synthesize toolkit; Filters a list of objects by the object's class name. Note that Dynamo elements belong to different classes than their Revit counterparts. Use the Object.Class node to check an object's class.
bounding_box_intersected_pairs = Custom[Bounding Box Intersected Pairs Combination](VARElements=byClassName.VARin)  # package Synthesize toolkit; Elements' Bounding Box Intersected Pairs Combination
code_block_2 = CodeBlock { 1; }
eq = n04_parameter_to_apply_rule_by_1 == code_block_2
code_block_3 = CodeBlock { "Length"; "Cut Length"; }
scopeIf = Custom[CW.ScopeIf+](VARtest=eq, VARtrue=code_block_3.out0, VARfalse=code_block_3.out1)  # package Synthesize toolkit; A (hopefully) more robust implementation of ScopeIf. Tests a single boolean and returns a value accordingly.
getParameterValueByName = Element.GetParameterValueByName(parameterName=scopeIf)  # unwired: element
sortByFunction = List.SortByFunction(list=bounding_box_intersected_pairs@L2, sortFunction=getParameterValueByName)
reverse = List.Reverse(list=sortByFunction@L2)
scopeIf_2 = Custom[CW.ScopeIf+](VARtest=n03_length_rule_apply, VARtrue=reverse, VARfalse=bounding_box_intersected_pairs)
flatten = List.Flatten(list=scopeIf_2@L2)
uniqueItems = List.UniqueItems(list=flatten)
reverse_2 = List.Reverse(list=uniqueItems@L2)
scopeIf_3 = Custom[CW.ScopeIf+](VARtest=n02_inverse_coping_ctrl_z_might, VARtrue=reverse_2, VARfalse=uniqueItems)
lastItem = List.LastItem(list=scopeIf_3@L2)
lastItem_2 = List.LastItem(list=scopeIf_2@L2)
firstItem = List.FirstItem(list=scopeIf_2@L2)
removeCoping = Custom[CW.FamilyInstance.RemoveCoping](VARfamilyInstance=lastItem_2, VARcuttingElementToBeRemoved=firstItem)  # package Synthesize toolkit; Removes a coping (cut) from a steel beam
reverse_3 = List.Reverse(list=scopeIf_2@L2)
lastItem_3 = List.LastItem(list=reverse_3@L2)
firstItem_2 = List.FirstItem(list=reverse_3@L2)
removeCoping_2 = Custom[CW.FamilyInstance.RemoveCoping](VARfamilyInstance=lastItem_3, VARcuttingElementToBeRemoved=firstItem_2)
create = List.Create(item0=removeCoping, item1=removeCoping_2)
passthrough = Custom[CW.Passthrough](VARpassThrough=lastItem, VARwaitFor=create)  # package Synthesize toolkit; Forces a sequential order of execution. The node wired into the output of the Passthrough node will be executed *after* the node wired into the waitFor input (e.g. important for some Revit operations). The value of the passThrough input will be passed on to the node wired into the output port of the Passthrough node.
firstItem_3 = List.FirstItem(list=scopeIf_3@L2)
passthrough_2 = Custom[CW.Passthrough](VARpassThrough=firstItem_3, VARwaitFor=create)
addCoping = Custom[CW.FamilyInstance.AddCoping](VARfamilyInstance=passthrough, VARcuttingElement=passthrough_2)  # package Synthesize toolkit; Adds a coping (cut) to a steel beam
end = Revit.Transaction.Transaction.End(input=addCoping)
getWarnings = Custom[ZK.Document.GetWarnings](VARRefresh=end)  # package Synthesize toolkit; NOTE: Works only with Revit 2018 and above! Get all warnings from the current document.
code_block_4 = CodeBlock { "Coping applied, but no cut was made. Adjust Coping Distance or Extension parameters."; }
eq_2 = getWarnings.WarningText == code_block_4
filterByBoolMask = List.FilterByBoolMask(list=getWarnings.FailingElementIds, mask=eq_2)
al_current_document = Custom[AL.Current Document]()  # package Synthesize toolkit; Retrieves Current Document
al_id_to_element = Custom[AL.Id to Element](VARIds=filterByBoolMask.in, VARDoc=al_current_document)  # package Synthesize toolkit; Selects elements in a model from id input (ElementId, string, integer or GUID)
id = Element.Id(element=al_id_to_element)
string_from_object = FromObject(obj=id)
concat = String.Concat(string0=string_from_object)
flatten_2 = List.Flatten(list=concat)
code_block_5 = CodeBlock { true; }
getWarnings_2 = Custom[ZK.Document.GetWarnings](VARRefresh=code_block_5)
code_block_6 = CodeBlock { "Coping applied, but no cut was made. Adjust Coping Distance or Extension parameters."; }
eq_3 = getWarnings_2.WarningText == code_block_6
filterByBoolMask_2 = List.FilterByBoolMask(list=getWarnings_2.FailingElementIds, mask=eq_3)
al_id_to_element_2 = Custom[AL.Id to Element](VARIds=filterByBoolMask_2.in, VARDoc=al_current_document)
id_2 = Element.Id(element=al_id_to_element_2)
string_from_object_2 = FromObject(obj=id_2)
create_2 = List.Create(item0=string_from_object_2)
python_empty_2_null = Custom[Python Empty 2 Null](VARIN=create_2)  # package Synthesize toolkit; Python Null 2 Empty
flatten_3 = List.Flatten(list=python_empty_2_null)
concat_2 = String.Concat(string0=flatten_3)
flatten_4 = List.Flatten(list=concat_2)
removeListFromList = Custom[RH.RemoveListFromList](VARListA=flatten_2, VARListB=flatten_4)  # package Synthesize toolkit; This node essentially "subtracts" the contents of List B from List A to produce a new list with the unique items.
hot_index_of_item = Custom[HOT.Index of item](VARList=flatten_2, VARItem=removeListFromList@L1)  # package Synthesize toolkit; Index of Item on List
itemAtIndex = Custom[SP.List.ItemAtIndex+](VARlist=al_id_to_element, VARindex=hot_index_of_item)  # package Synthesize toolkit; Identical to the built in node but works with negative indices
scopeIf_4 = Custom[CW.ScopeIf+](VARtest=n05_remove_all_existed_copping, VARtrue=al_id_to_element, VARfalse=itemAtIndex)
lastItem_4 = List.LastItem(list=scopeIf_4@L2)
firstItem_4 = List.FirstItem(list=scopeIf_4@L2)
removeCoping_3 = Custom[CW.FamilyInstance.RemoveCoping](VARfamilyInstance=lastItem_4, VARcuttingElementToBeRemoved=firstItem_4)
removeCoping_4 = Custom[CW.FamilyInstance.RemoveCoping](VARfamilyInstance=firstItem_4, VARcuttingElementToBeRemoved=lastItem_4)
debug_python = Custom[Debug Python]()  # package Synthesize toolkit; Debug Python
