# Dynamo graph Structural.Copping Distance Parameters Management By Interference Check.dyn (Dynamo 2.13.1.3887)
# author: karam@aecedx.com
# packages: Synthesize toolkit 12.5.1

# group: Input
n08_create_selection_filters = BoolSelector(false)  # "08.Create Selection Filters ?"; graph input
n11_filter_name_for_end_join = StringInput("Dynamo Detected Framing End Join Cutback")  # "11.Filter Name For End Join Cutback Elements"; graph input
n09_overwrite_existing_filter = BoolSelector(false)  # "09.Overwrite Existing Filter ?"; graph input
n01_interference_file = Filename("No file selected.")  # "01.Interference File"; graph input
n10_filter_name_for_start_join = StringInput("Dynamo Detected Framing Start Join Cutback")  # "10.Filter Name For Start Join Cutback Elements"; graph input
n12_filter_name_for_coping = StringInput("Dynamo Detected Framing Coping Distance")  # "12.Filter Name For Coping Distance Elements"; graph input
n04_change_end_join_cutback = BoolSelector(false)  # "04.Change End Join Cutback Parameter ?"; graph input
n05_end_join_cutback = DoubleInput(-0.1)  # "05.End Join Cutback"; graph input
n02_change_start_join_cutback = BoolSelector(false)  # "02.Change Start Join Cutback Parameter ?"; graph input
n03_start_join_cutback = DoubleInput(-0.1)  # "03.Start Join Cutback"; graph input
n06_change_coping_distance = BoolSelector(true)  # "06.Change Coping Distance Parameter ?"; graph input
n07_copping_distance = DoubleInput(0)  # "07.Copping Distance"; graph input

k_interference_check = Custom[K-Interference Check](VARReport=n01_interference_file)  # package Synthesize toolkit; K-Interference Check
flatten = List.Flatten(list=k_interference_check.VARAffectedElements)
code_block = CodeBlock { "framing"; }
byClassName = Custom[SP.Filter.ByClassName](VARobject=flatten, VARclassName=code_block)  # package Synthesize toolkit; Filters a list of objects by the object's class name. Note that Dynamo elements belong to different classes than their Revit counterparts. Use the Object.Class node to check an object's class.
flatten_2 = List.Flatten(list=byClassName.VARin)
code_block_2 = CodeBlock { "End Join Cutback"; }
getParameterValueByName = Element.GetParameterValueByName(element=flatten_2, parameterName=code_block_2)
code_block_3 = CodeBlock { ""; }
eq = getParameterValueByName == code_block_3
filterByBoolMask = List.FilterByBoolMask(list=flatten_2, mask=eq)
generate_selection_filter = Custom[Generate Selection Filter](VARCreateSelectionFilter=n08_create_selection_filters, VARFilterNametoCreate=n11_filter_name_for_end_join, VAROverwriteExistingFilter=n09_overwrite_existing_filter, VARElements=filterByBoolMask.out)  # package Synthesize toolkit; Generate Selection FIlter
code_block_4 = CodeBlock { "Start Join Cutback"; }
getParameterValueByName_2 = Element.GetParameterValueByName(element=flatten_2, parameterName=code_block_4)
code_block_5 = CodeBlock { ""; }
eq_2 = getParameterValueByName_2 == code_block_5
filterByBoolMask_2 = List.FilterByBoolMask(list=flatten_2, mask=eq_2)
generate_selection_filter_2 = Custom[Generate Selection Filter](VARCreateSelectionFilter=n08_create_selection_filters, VARFilterNametoCreate=n10_filter_name_for_start_join, VAROverwriteExistingFilter=n09_overwrite_existing_filter, VARElements=filterByBoolMask_2.out)
code_block_6 = CodeBlock { "Coping Distance"; }
getParameterValueByName_3 = Element.GetParameterValueByName(element=flatten_2, parameterName=code_block_6)
code_block_7 = CodeBlock { ""; }
eq_3 = getParameterValueByName_3 == code_block_7
filterByBoolMask_3 = List.FilterByBoolMask(list=flatten_2, mask=eq_3)
generate_selection_filter_3 = Custom[Generate Selection Filter](VARCreateSelectionFilter=n08_create_selection_filters, VARFilterNametoCreate=n12_filter_name_for_coping, VAROverwriteExistingFilter=n09_overwrite_existing_filter, VARElements=filterByBoolMask_3.out)

# group: Report
n01_elements_of_start_join = Watch(filterByBoolMask_2.out)  # "01.Elements of Start Join Cutback"; graph output
n02_elements_of_end_join_cutback = Watch(filterByBoolMask.out)  # "02.Elements of End Join Cutback"; graph output
n03_elements_of_coping_distance = Watch(filterByBoolMask_3.out)  # "03.Elements of Coping Distance"; graph output

code_block_8 = CodeBlock { null; false; }
scopeIf = Custom[CW.ScopeIf+](VARtest=n04_change_end_join_cutback, VARtrue=filterByBoolMask.out, VARfalse=code_block_8.out0)  # package Synthesize toolkit; A (hopefully) more robust implementation of ScopeIf. Tests a single boolean and returns a value accordingly.
clean = List.Clean(list=scopeIf, preserveIndices=code_block_8.out1)
setParameterByName = Element.SetParameterByName(element=clean, parameterName=code_block_2, value=n05_end_join_cutback)
code_block_9 = CodeBlock { null; false; }
scopeIf_2 = Custom[CW.ScopeIf+](VARtest=n02_change_start_join_cutback, VARtrue=filterByBoolMask_2.out, VARfalse=code_block_9.out0)
clean_2 = List.Clean(list=scopeIf_2, preserveIndices=code_block_9.out1)
setParameterByName_2 = Element.SetParameterByName(element=clean_2, parameterName=code_block_4, value=n03_start_join_cutback)
code_block_10 = CodeBlock { null; false; }
scopeIf_3 = Custom[CW.ScopeIf+](VARtest=n06_change_coping_distance, VARtrue=filterByBoolMask_3.out, VARfalse=code_block_10.out0)
clean_3 = List.Clean(list=scopeIf_3, preserveIndices=code_block_10.out1)
setParameterByName_3 = Element.SetParameterByName(element=clean_3, parameterName=code_block_6, value=n07_copping_distance)
debug_python = Custom[Debug Python]()  # package Synthesize toolkit; Debug Python
