# Dynamo graph Structural.Framing Fix Extents By Inerference Check.dyn (Dynamo 2.13.1.3887)
# author: karam@aecedx.com
# packages: Synthesize toolkit 12.5.1

# group: Input
n01_interference_file = Filename("No file selected.")  # "01.Interference File"; graph input
margin = DoubleInput(0)  # "02.Margin"; graph input

k_interference_check = Custom[K-Interference Check](VARReport=n01_interference_file)  # package Synthesize toolkit; K-Interference Check
flatten = List.Flatten(list=k_interference_check.VARAffectedElements)
fixExtents = Custom[SP.Beams.FixExtents](VARbeams=flatten, VARmargin=margin)  # package Synthesize toolkit; Detects all beams from the input list with broken extents(actual length - cut length < margin) and attemts to correct them.
debug_python = Custom[Debug Python]()  # package Synthesize toolkit; Debug Python
