# Dynamo graph Structural.Framing Fix Extents By Selection.dyn (Dynamo 2.13.1.3887)
# author: karam@aecedx.com
# packages: Synthesize toolkit 12.5.1

# group: Input
n01_select_elements = DSModelElementsSelection()  # "01.Select Elements"; nothing selected; graph input
margin = DoubleInput(0)  # "02.Margin"; graph input

fixExtents = Custom[SP.Beams.FixExtents](VARbeams=n01_select_elements, VARmargin=margin)  # package Synthesize toolkit; Detects all beams from the input list with broken extents(actual length - cut length < margin) and attemts to correct them.
debug_python = Custom[Debug Python]()  # package Synthesize toolkit; Debug Python
