# Dynamo graph Text.Circulation By Curve Lengths and Travel Speed.dyn (Dynamo 2.13.1.3887)
# author: karam@aecedx.com
# packages: Synthesize toolkit 12.5.1

# group: Input
n04_place_text_notes = BoolSelector(true)  # "04.Place Text Notes ?"; graph input
n01_select_curves = DSModelElementsSelection()  # "01.Select Curves"; nothing selected; graph input
n03_locateion_0_beginning_0_5 = DoubleSlider(0, range=0..1 step 0.5)  # "03.Locateion (0 = Beginning | 0.5 = Middle | 1 = End)"; graph input
n02_speed_default_is_meters_per = DoubleInput(1.4)  # "02.Speed (Default is Meters Per Second)"; graph input

hot_get_revit_activeview = Custom[HOT.Get Revit ActiveView]()  # package Synthesize toolkit; Active View
code_block = CodeBlock { null; }
scopeIf = Custom[CW.ScopeIf+](VARtest=n04_place_text_notes, VARtrue=hot_get_revit_activeview, VARfalse=code_block)  # package Synthesize toolkit; A (hopefully) more robust implementation of ScopeIf. Tests a single boolean and returns a value accordingly.
turnIntoList = Custom[CW.TurnIntoList](VARunknownItem=scopeIf)  # package Synthesize toolkit; Turns an element (or a nested list) into a flat list
code_block_2 = CodeBlock { false; }
clean = List.Clean(list=turnIntoList, preserveIndices=code_block_2)
flatten = List.Flatten(list=clean)
curves = Element.Curves(element=n01_select_curves)
flatten_2 = List.Flatten(list=curves)
as_polycurve_bycurves = Custom[AS.[&] PolyCurve.ByCurves](VARcurves=flatten_2)  # package Synthesize toolkit; Create polycurves from an unordered list of curves.
pointAtParameter = Curve.PointAtParameter(curve=as_polycurve_bycurves.VARpolyCurve, param=n03_locateion_0_beginning_0_5, lacing=Longest)
join = List.Join()  # unwired: list0, list1, list2, list3
length = Curve.Length(curve=as_polycurve_bycurves.VARpolyCurve)
code_block_3 = CodeBlock { 1; 2; }
toString = Custom[SP.Number.ToString](VARnum=length, VARdigits=code_block_3.out1)  # package Synthesize toolkit; Converts the input number(s) to string. You can optionally limit the number of digits.
div = length / n02_speed_default_is_meters_per
roundToPrecision = Custom[CW.Math.RoundToPrecision](VARdbl=div, VARprecision=code_block_3.out0)  # package Synthesize toolkit; Rounds a number to a specified precision
toString_2 = Custom[SP.Number.ToString](VARnum=roundToPrecision, VARdigits=code_block_3.out0)
code_block_4 = CodeBlock { " / "; "s"; }
matchLength = Custom[LF.List.MatchLength](VARlistLength=toString_2, VARlist=code_block_4.out0)  # package Synthesize toolkit; Cycle a list to match the length of the first list.
matchLength_2 = Custom[LF.List.MatchLength](VARlistLength=toString_2, VARlist=code_block_4.out1)
combine = List.Combine(comb=join, list1=toString, list2=matchLength, list3=toString_2, list4=matchLength_2)
string_from_object = FromObject(obj=combine)
concat = String.Concat(string0=string_from_object)
flatten_3 = List.Flatten(list=concat)
code_block_5 = CodeBlock { "Middle"; }
default = TextNoteType.Default()
byLocation = TextNote.ByLocation(view=flatten, location=pointAtParameter, text=flatten_3, alignment=code_block_5, type=default, lacing=Longest)

# group: Report
n01_distance_speed = Watch(flatten_3)  # "01.Distance / Speed"; graph output

debug_python = Custom[Debug Python]()  # package Synthesize toolkit; Debug Python
