# Dynamo graph Topography.Auto K-Fence.dyn (Dynamo 2.13.1.3887)
# author: karam@aecedx.com
# packages: Synthesize toolkit 12.5.1

debug_python = Custom[Debug Python]()  # package Synthesize toolkit; Debug Python

# group: Input
n01_select_pads_or_floors_to_auto = DSModelElementsSelection()  # "01.Select Pads or Floors to Auto Fence"; nothing selected; graph input
n08_split_outer_fencing = BoolSelector(true)  # "08.Split Outer Fencing ?"; graph input
n09_split_outer_fencing_distance = DoubleInput(20)  # "09.Split Outer Fencing : Distance"; graph input
n07_extra_outer_fence_depth = DoubleInput(-3)  # "07.Extra Outer Fence Depth"; graph input
n03_inner_wall_types = WallTypes()  # "03.Inner Wall Types"; nothing selected; graph input
n02_build_inner_fence = BoolSelector(true)  # "02.Build Inner Fence"; graph input
n05_outer_wall_types = WallTypes()  # "05.Outer Wall Types"; nothing selected; graph input
n06_extra_outer_fence_height = DoubleInput(1.5)  # "06.Extra Outer Fence Height"; graph input
n04_build_outer_fence = BoolSelector(true)  # "04.Build Outer Fence"; graph input
n10_create_selection_filter_for = BoolSelector(true)  # "10.Create Selection Filter for Walls Auto Fence"; graph input
n11_filter_name_for_pads_outer = StringInput("Dynamo Auto K-Fence - Outer Walls")  # "11.Filter Name for Pads - Outer Fence"; graph input
n13_overwrite_existing_filter = BoolSelector(false)  # "13.Overwrite Existing Filter ? (False for Adding Elements)"; graph input
n12_filter_name_for_pads_inner = StringInput("Dynamo Auto K-Fence - Inner Walls")  # "12.Filter Name for Pads - Inner Fence"; graph input

string_from_object = FromObject(obj=n01_select_pads_or_floors_to_auto)
code_block = CodeBlock { "BuildingPad"; "Floor"; }
eq = string_from_object == code_block.out0
filterByBoolMask = List.FilterByBoolMask(list=n01_select_pads_or_floors_to_auto, mask=eq)
byClassName = Custom[SP.Filter.ByClassName](VARobject=filterByBoolMask.out, VARclassName=code_block.out1)  # package Synthesize toolkit; Filters a list of objects by the object's class name. Note that Dynamo elements belong to different classes than their Revit counterparts. Use the Object.Class node to check an object's class.
create = List.Create(item0=filterByBoolMask.in, item1=byClassName.VARin)
code_block_2 = CodeBlock { false; }
clean = List.Clean(list=create, preserveIndices=code_block_2)
flatten = List.Flatten(list=clean)
element_geometry_fixer = Custom[Element.Geometry Fixer](VARElement=flatten)  # package Synthesize toolkit; Element.Geometry Fixer
explode = Geometry.Explode(geometry=element_geometry_fixer)
filterByOrientation = Custom[CW.Surface.FilterByOrientation](VARsurfaces=explode)  # package Synthesize toolkit; Sorts surfaces in three lists based on their orientation (vertical, horizontal up & horizontal down) and also returns three corresponding lists of booleans.
flatten_2 = List.Flatten(list=filterByOrientation.VARhorizontalUp)
code_block_3 = CodeBlock { false; }
join_adjacent_surfaces = Custom[Join Adjacent Surfaces](VARSurfaces=flatten_2, VARNormalsCheck=code_block_3)  # package Synthesize toolkit; Join Adjacent Surfaces
perimeterCurves = Surface.PerimeterCurves(surface=join_adjacent_surfaces)
as_polycurve_bycurves = Custom[AS.[&] PolyCurve.ByCurves](VARcurves=perimeterCurves)  # package Synthesize toolkit; Create polycurves from an unordered list of curves.
isNull = Object.IsNull(object=as_polycurve_bycurves.VARpolyCurve)
allTrue = List.AllTrue(list=isNull@L2)
filterByBoolMask_2 = List.FilterByBoolMask(list=join_adjacent_surfaces, mask=allTrue)
explode_2 = Geometry.Explode(geometry=filterByBoolMask_2.in)
flatten_3 = List.Flatten(list=explode_2)
perimeterCurves_2 = Surface.PerimeterCurves(surface=flatten_3)
as_polycurve_bycurves_2 = Custom[AS.[&] PolyCurve.ByCurves](VARcurves=perimeterCurves_2)
create_2 = List.Create(item0=as_polycurve_bycurves_2.VARpolyCurve, item1=as_polycurve_bycurves.VARpolyCurve)
code_block_4 = CodeBlock { false; }
clean_2 = List.Clean(list=create_2, preserveIndices=code_block_4)
curves = PolyCurve.Curves(polyCurve=clean_2)
curves_offset_to_revit = Custom[Curves Offset To Revit Compatibility](VARCurves=curves@L3)  # package Synthesize toolkit; Curves Offset To Revit Compatibility
flatten_4 = List.Flatten(list=curves_offset_to_revit.VARCurves)
python_script = Python(IN[0]=flatten_4, IN[1]=flatten, IN[2]=n08_split_outer_fencing, IN[3]=n09_split_outer_fencing_distance, IN[4]=n07_extra_outer_fence_depth)  # IronPython2
# ---------- python_script.python (244 lines) ----------
# Enable Python support and load DesignScript library
# IMPORTANT : ALL DYNAMO DESIGN SCRIPT NODES ARE AS (dg)
import clr
clr.AddReference('ProtoGeometry')
from Autodesk.DesignScript import Geometry as dg

# EXTENSION Enable ToDSType
clr.AddReference('RevitNodes')
import Revit
clr.ImportExtensions(Revit.Elements)

# Enable Revit Elements
from Revit.Elements import *

# EXTENSION Enable Geometry Conversion Methods
clr.ImportExtensions(Revit.GeometryConversion)

# Enable Revit API
clr.AddReference('RevitAPI')
from Autodesk.Revit.DB import *

# Enable DocumentManager and TransactionManager
clr.AddReference('RevitServices')
from RevitServices.Persistence import DocumentManager
from RevitServices.Transactions import TransactionManager

# Enable ICollection List Translate
clr.AddReference("System")
import System.Collections.Generic
from System.Collections.Generic import List

from System import Array

def detectinner(innerwalls,inner,todetect):
	result_innerlines = []
	result_innerheights = []
	counter = 0
	for e in inner:
		extruded = dg.Curve.Extrude(e,zvec,1000)
		translatedextrud = dg.Geometry.Translate(extruded,0,0,0.1)
		intersects = []
		heights = []
		distancesto = []
		for i in todetect:
			try:
				if dg.Geometry.DistanceTo(translatedextrud, i) < 0.01:
					heights.append(i.StartPoint.Z)
					intersects.append(innerwalls[counter])
					distancesto.append(dg.Geometry.DistanceTo(e,i))
			except:
				pass
				
		if len(heights) != 0:
			maxheight = max(heights)
			incount = 0
			for h in heights:
				if maxheight == h:
					wantedline = intersects[incount]
					wanteddistance = distancesto[incount]
				incount += 1
		else:
			wantedline = None
			wanteddistance = None
		result_innerlines.append(wantedline)
		result_innerheights.append(wanteddistance)
		counter += 1
	return result_innerlines,result_innerheights

def normcurve(singlecurve,outerdistance):
	try:
		length = round(singlecurve.Length/outerdistance)
		a = range(0,int(length))
		points = []
		amin, amax = min(a), max(a)
		floats = []
		for val in a:
			floats.append(float(val-amin) / float(amax-amin))
		cparams = Array[float](floats)
		csplitted = dg.Curve.SplitByParameter(singlecurve,cparams)
	except:
		csplitted = singlecurve
	return csplitted

def flatten(x):
    result = []
    for el in x:
        if hasattr(el, "__iter__") and not isinstance(el, basestring):
            result.extend(flatten(el))
        else:
            result.append(el)
    return result

def tolist(obj1):
	if hasattr(obj1,'__iter__'): return obj1
	else: return [obj1]

def get_topo(pads,doc):
	pads = tolist(pads)
	topos = FilteredElementCollector(doc).OfCategory(BuiltInCategory.OST_Topography).WhereElementIsNotElementType().ToElements()
	bbox = []
	volumes = []
	padsbbox = []
	for e in topos:
		try:
			bb = e.get_BoundingBox(None).ToProtoType()
			bbox.append(bb)
			cub = bb.ToCuboid()
			vol = cub.Volume
			volumes.append(vol)
			cub.Dispose()
		except:
			pass
	maxvol = max(volumes)
	biggest = []
	counter = 0
	for e in volumes:
		if maxvol == e:
			biggest = bbox[counter]
			break
		counter += 1
		
	minp = biggest.MinPoint
	maxp = biggest.MaxPoint
	
	for p in pads:
		pbox = p.get_BoundingBox(None).ToProtoType()
		pboxmin = pbox.MinPoint
		pboxmax = pbox.MaxPoint
		
		newmin = dg.Point.ByCoordinates(pboxmin.X,pboxmin.Y,minp.Z)
		newmax = dg.Point.ByCoordinates(pboxmax.X,pboxmax.Y,maxp.Z)
		pbox = dg.BoundingBox.ByCorners(newmin,newmax)
		padsbbox.append(pbox)
	final = []
	for e in padsbbox:
		counter = 0
		for x in bbox:
			if dg.BoundingBox.Intersects(e,x):
				final.append(topos[counter])
			counter += 1
	final = list(set(final))
	return final
 
 # Choose The Current Document
doc = DocumentManager.Instance.CurrentDBDocument
uidoc = DocumentManager.Instance.CurrentUIApplication.ActiveUIDocument
uiapp = DocumentManager.Instance.CurrentUIApplication
app = uiapp.Application
dataEnteringNode = IN

# Use UnwrapElement(IN[0]) When Translating From Dynamo to Revit
innerwalls=UnwrapElement(IN[0])
pads=UnwrapElement(IN[1])
splithem = IN[2]
fencedistancing = IN[3]
extranumber = IN[4]

extend = 0.1
shortenfactor = 0.01
zvec = dg.Vector.ZAxis()

nonurbs = []
for e in innerwalls:
	if hasattr(e, 'Weights') == False:
		nonurbs.append(e)
innerwalls = nonurbs

topo = get_topo(pads,doc)

topopolycurves = []
opt1 = Options()
for t in topo:
	try:
		geoms = t.get_Geometry(opt1)
		for g in geoms:
			if g.ToString() == "Autodesk.Revit.DB.PolyLine":
				try:
					converted = g.ToProtoType()
				except: 
					continue
				try:
					extendedstart = dg.Curve.ExtendStart(converted,extend)
					extendedend = dg.Curve.ExtendEnd(extendedstart,extend)
					extendedend = dg.Geometry.Translate(extendedend,0,0,extranumber*-1)
					topopolycurves.append(extendedend)
				except:
					topopolycurves.append(converted)
	except:
		pass

inner = []
for g in innerwalls:
	converted = g
	shorten = g.Length * -shortenfactor
	extendedstart = dg.Curve.ExtendStart(converted,shorten)
	extendedend = dg.Curve.ExtendEnd(extendedstart,shorten)
	inner.append(extendedend)

result = detectinner(innerwalls,inner,inner)
result_innerlines = result[0]
result_innerheights = result[1]

newraw = []
newinner = []
counter = 0
for e in result_innerlines:
	if e == None:
		newraw.append(innerwalls[counter])
		newinner.append(inner[counter])
	counter += 1

if splithem == True:
	splitnewraw = []
	for e in newraw:
		splitnewraw.append(normcurve(e,fencedistancing))
	splitnewraw = flatten(splitnewraw)

	splitnewinner = []
	for g in splitnewraw:
		converted = g
		shorten = g.Length * -shortenfactor
		extendedstart = dg.Curve.ExtendStart(converted,shorten)
		extendedend = dg.Curve.ExtendEnd(extendedstart,shorten)
		splitnewinner.append(extendedend)
else:
	splitnewraw = newraw
	splitnewinner = newinner

resultouter = detectinner(splitnewraw,splitnewinner,topopolycurves)
result_outerlines = resultouter[0]
result_outerheights = resultouter[1]

fixed_outerheights = []
for e in result_outerheights:
	try:
		number = e+extranumber
		if number < 0:
			number = 0
		fixed_outerheights.append(number)
	except:
		fixed_outerheights.append(e)
result_outerheights = fixed_outerheights
# Assign your output to the OUT variable.
OUT = result_innerlines,result_innerheights,result_outerlines,result_outerheights
# ----------------------------------------

# group: Inner
code_block_5 = CodeBlock(a=python_script) { a[0]; a[1]; }

code_block_6 = CodeBlock { false; }
clean_3 = List.Clean(list=code_block_5.out0, preserveIndices=code_block_6)
code_block_7 = CodeBlock { true; 0.001; 0; 1000; }
categories = Categories("OST_Levels")
all_elements_of_category = ElementsOfCategory(Category=categories)
startPoint = Curve.StartPoint(curve=clean_3)
detect_levels_of_points = Custom[Detect Levels of Points](VARSetOffsetParameter=code_block_7.out0, VARRoundingValue=code_block_7.out1, VARRoundingFix=code_block_7.out0, VARFixFactorDependsofProjectUnits1Formetersforexampleand100forCentimeters=code_block_7.out3, VARLevels=all_elements_of_category, VARPoints=startPoint, VARZLocationOffset=code_block_7.out2)  # package Synthesize toolkit; Detect Levels of Points From Family Refine Levels and Offset
code_block_8 = CodeBlock { false; }
clean_4 = List.Clean(list=code_block_5.out1, preserveIndices=code_block_8)

# group: Outer
code_block_9 = CodeBlock(a=python_script) { a[2]; a[3]; }

code_block_10 = CodeBlock { false; }
clean_5 = List.Clean(list=code_block_9.out0, preserveIndices=code_block_10)
startPoint_2 = Curve.StartPoint(curve=clean_5)
detect_levels_of_points_2 = Custom[Detect Levels of Points](VARSetOffsetParameter=code_block_7.out0, VARRoundingValue=code_block_7.out1, VARRoundingFix=code_block_7.out0, VARFixFactorDependsofProjectUnits1Formetersforexampleand100forCentimeters=code_block_7.out3, VARLevels=all_elements_of_category, VARPoints=startPoint_2, VARZLocationOffset=n07_extra_outer_fence_depth)
code_block_11 = CodeBlock { false; }
clean_6 = List.Clean(list=code_block_9.out1, preserveIndices=code_block_11)
add = clean_6 + n06_extra_outer_fence_height
code_block_12 = CodeBlock(a=n07_extra_outer_fence_depth) { a*-1; }
add_2 = add + code_block_12
python_script_2 = Python(IN[0]=clean_5, IN[1]=n05_outer_wall_types, IN[2]=detect_levels_of_points_2.VARLevelsSet, IN[3]=add_2, IN[4]=detect_levels_of_points_2.VARElevationsSet, IN[5]=n04_build_outer_fence)  # IronPython2
# ---------- python_script_2.python (178 lines) ----------
# Enable Python support and load DesignScript library
# IMPORTANT : ALL DYNAMO DESIGN SCRIPT NODES ARE AS (dg)
import clr
clr.AddReference('ProtoGeometry')
from Autodesk.DesignScript import Geometry as dg

import sys
sys.path.append(r'C:\Program Files (x86)\IronPython 2.7\DLLs')
sys.path.append(r'C:\Program Files (x86)\IronPython 2.7\Lib')
import random

# EXTENSION Enable ToDSType
clr.AddReference('RevitNodes')
import Revit
clr.ImportExtensions(Revit.Elements)

# Enable Revit Elements
from Revit.Elements import *

# EXTENSION Enable Geometry Conversion Methods
clr.ImportExtensions(Revit.GeometryConversion)

# Enable Revit API
clr.AddReference('RevitAPI')
from Autodesk.Revit.DB import *

# Enable DocumentManager and TransactionManager
clr.AddReference('RevitServices')
from RevitServices.Persistence import DocumentManager
from RevitServices.Transactions import TransactionManager

# Enable ICollection List Translate
clr.AddReference("System")
import System.Collections.Generic
from System.Collections.Generic import List

class WarnSwallow(IFailuresPreprocessor):
	def PreprocessFailures(self, failuresAccessor):
		failuresAccessor.DeleteAllWarnings()
		return FailureProcessingResult.Continue

dataEnteringNode = IN
# Use UnwrapElement(IN[0]) When Translating From Dynamo to Revit
curves = UnwrapElement(IN[0])
walltypeid = UnwrapElement(IN[1]).Id
levels = UnwrapElement(IN[2])
heights = UnwrapElement(IN[3])
offsets = UnwrapElement(IN[4])
proceed = IN[5]

levelids = []
for e in levels:
	levelids.append(e.Id)
# Choose The Current Document
doc = DocumentManager.Instance.CurrentDBDocument
uidoc = DocumentManager.Instance.CurrentUIApplication.ActiveUIDocument
uiapp = DocumentManager.Instance.CurrentUIApplication
app = uiapp.Application

# Create Empty List
result = []

if int(DocumentManager.Instance.CurrentUIApplication.Application.VersionNumber) < 2021:
	units = doc.GetUnits().GetFormatOptions(UnitType.UT_Length).DisplayUnits
	factor = UnitUtils.ConvertToInternalUnits(1,units)
else:
	factor = UnitUtils.ConvertToInternalUnits(1,doc.GetUnits().GetFormatOptions(SpecTypeId.Length).GetUnitTypeId())

if proceed == True:
	###STEP 1 NEW TYPE###
	TransactionManager.Instance.ForceCloseTransaction()
	tGroup = TransactionGroup(doc, 'K-Fence Outer')
	tGroup.Start()
	trans1 = Transaction(doc, 'Outer : Creating Temporary Wall Type')
	trans1.Start()
	foptions = trans1.GetFailureHandlingOptions()
	foptions.SetFailuresPreprocessor(WarnSwallow())
	trans1.SetFailureHandlingOptions(foptions)
	existedwalltype = doc.GetElement(walltypeid)
	duplicated = doc.GetElement(walltypeid).Duplicate("TMP " + str(existedwalltype.Id) + " " + str(random.randint(1,99999)))
	thecompound = CompoundStructure.CreateSingleLayerCompoundStructure(MaterialFunctionAssignment.Structure,existedwalltype.Width/2,FilteredElementCollector(doc).OfClass(Material).FirstElementId())
	duplicated.SetCompoundStructure(thecompound)
	trans1.Commit()
	
	###STEP 2 CREATE WALLS###
	#Revit.Transaction.Transaction.End(doc)
	trans2 = Transaction(doc, 'Outer : Creating Walls')
	trans2.Start()
	foptions = trans2.GetFailureHandlingOptions()
	foptions.SetFailuresPreprocessor(WarnSwallow())
	trans2.SetFailureHandlingOptions(foptions)
	counter = 0
	for c in curves:
		try:
			wallcreate = Wall.Create(doc,c.ToRevitType(),existedwalltype.Id,levelids[counter],heights[counter]*factor,offsets[counter]*factor,False,False)
			param = wallcreate.get_Parameter(BuiltInParameter.WALL_KEY_REF_PARAM).Set(2)
			result.append(wallcreate)
		except:
			pass
		counter += 1
	trans2.Commit()
	#Revit.Transaction.Transaction.End(doc)
	
	if len(result) > 0:
		###STEP 3 SET NEW TYPE###
		trans3 = Transaction(doc, 'Outer : Set to Temporary Wall Type')
		trans3.Start()
		foptions = trans3.GetFailureHandlingOptions()
		foptions.SetFailuresPreprocessor(WarnSwallow())
		trans3.SetFailureHandlingOptions(foptions)
		for e in result:
			try:
				WallUtils.DisallowWallJoinAtEnd(e,0)
				WallUtils.DisallowWallJoinAtEnd(e,1)
				e.ChangeTypeId(duplicated.Id)
			except:
				pass
		trans3.Commit()
		
		Revit.Transaction.Transaction.End(doc)
		###STEP 4 SET EXTERIOR LOCATION LINE###
		trans4 = Transaction(doc, 'Outer : Set Exterior Location Line For Walls')
		trans4.Start()
		foptions = trans4.GetFailureHandlingOptions()
		foptions.SetFailuresPreprocessor(WarnSwallow())
		trans4.SetFailureHandlingOptions(foptions)
		for e in result:
			try:
				e.get_Parameter(BuiltInParameter.WALL_KEY_REF_PARAM).Set(3)
			except:
				pass
		trans4.Commit()
		
		#Revit.Transaction.Transaction.End(doc)
		###STEP 5 RESTORE EXISTED TYPE###
		trans5 = Transaction(doc, 'Outer : Restore Correct Wall Type')
		trans5.Start()
		foptions = trans5.GetFailureHandlingOptions()
		foptions.SetFailuresPreprocessor(WarnSwallow())
		trans5.SetFailureHandlingOptions(foptions)
		for e in result:
			try:
				e.ChangeTypeId(existedwalltype.Id)
			except:
				pass
		trans5.Commit()
		
		#Revit.Transaction.Transaction.End(doc)
		###STEP 6 SET INTERIOR LOCATION LINE###
		trans6 = Transaction(doc, 'Outer : Set Interior Location Line')
		trans6.Start()
		foptions = trans6.GetFailureHandlingOptions()
		foptions.SetFailuresPreprocessor(WarnSwallow())
		trans6.SetFailureHandlingOptions(foptions)
		for e in result:
			try:
				e.get_Parameter(BuiltInParameter.WALL_KEY_REF_PARAM).Set(3)
				WallUtils.AllowWallJoinAtEnd(e,0)
				WallUtils.AllowWallJoinAtEnd(e,1)
			except:
				pass
		doc.Delete(duplicated.Id)
		trans6.Commit()
		tGroup.Assimilate()
		# Assign your output to the OUT variable.
		OUT = result
	else:
		trans3 = Transaction(doc, 'Outer : Deleting Temporary Wall Type')
		trans3.Start()
		foptions = trans3.GetFailureHandlingOptions()
		foptions.SetFailuresPreprocessor(WarnSwallow())
		trans3.SetFailureHandlingOptions(foptions)
		doc.Delete(duplicated.Id)	
		trans3.Commit()
		tGroup.Assimilate()
		OUT = None
else:
	OUT = None
# ----------------------------------------
python_script_3 = Python(IN[0]=clean_3, IN[1]=n03_inner_wall_types, IN[2]=detect_levels_of_points.VARLevelsSet, IN[3]=clean_4, IN[4]=detect_levels_of_points.VARElevationsSet, IN[5]=n02_build_inner_fence, IN[6]=python_script_2)  # IronPython2
# ---------- python_script_3.python (194 lines) ----------
# Enable Python support and load DesignScript library
# IMPORTANT : ALL DYNAMO DESIGN SCRIPT NODES ARE AS (dg)
import clr
clr.AddReference('ProtoGeometry')
from Autodesk.DesignScript import Geometry as dg

import sys
sys.path.append(r'C:\Program Files (x86)\IronPython 2.7\DLLs')
sys.path.append(r'C:\Program Files (x86)\IronPython 2.7\Lib')
import random

# EXTENSION Enable ToDSType
clr.AddReference('RevitNodes')
import Revit
clr.ImportExtensions(Revit.Elements)

# Enable Revit Elements
from Revit.Elements import *

# EXTENSION Enable Geometry Conversion Methods
clr.ImportExtensions(Revit.GeometryConversion)

# Enable Revit API
clr.AddReference('RevitAPI')
from Autodesk.Revit.DB import *

# Enable DocumentManager and TransactionManager
clr.AddReference('RevitServices')
from RevitServices.Persistence import DocumentManager
from RevitServices.Transactions import TransactionManager

# Enable ICollection List Translate
clr.AddReference("System")
import System.Collections.Generic
from System.Collections.Generic import List

class WarnSwallow(IFailuresPreprocessor):
	def PreprocessFailures(self, failuresAccessor):
		failuresAccessor.DeleteAllWarnings()
		return FailureProcessingResult.Continue

dataEnteringNode = IN
# Use UnwrapElement(IN[0]) When Translating From Dynamo to Revit
curves = UnwrapElement(IN[0])
walltypeid = UnwrapElement(IN[1]).Id
levels = UnwrapElement(IN[2])
heights = UnwrapElement(IN[3])
offsets = UnwrapElement(IN[4])
proceed = IN[5]
junkwait = IN[6]

levelids = []
for e in levels:
	levelids.append(e.Id)
# Choose The Current Document
doc = DocumentManager.Instance.CurrentDBDocument
uidoc = DocumentManager.Instance.CurrentUIApplication.ActiveUIDocument
uiapp = DocumentManager.Instance.CurrentUIApplication
app = uiapp.Application

# Create Empty List
result = []

if int(DocumentManager.Instance.CurrentUIApplication.Application.VersionNumber) < 2021:
	units = doc.GetUnits().GetFormatOptions(UnitType.UT_Length).DisplayUnits
	factor = UnitUtils.ConvertToInternalUnits(1,units)
else:
	factor = UnitUtils.ConvertToInternalUnits(1,doc.GetUnits().GetFormatOptions(SpecTypeId.Length).GetUnitTypeId())

if proceed == True:
	###STEP 1 NEW TYPE###
	TransactionManager.Instance.ForceCloseTransaction()
	tGroup = TransactionGroup(doc, 'K-Fence Inner')
	tGroup.Start()
	trans1 = Transaction(doc, 'Inner : Creating Temporary Wall Type')
	trans1.Start()
	foptions = trans1.GetFailureHandlingOptions()
	foptions.SetFailuresPreprocessor(WarnSwallow())
	trans1.SetFailureHandlingOptions(foptions)
	existedwalltype = doc.GetElement(walltypeid)
	duplicated = doc.GetElement(walltypeid).Duplicate("TMP " + str(existedwalltype.Id) + " " + str(random.randint(1,99999)))
	thecompound = CompoundStructure.CreateSingleLayerCompoundStructure(MaterialFunctionAssignment.Structure,existedwalltype.Width/2,FilteredElementCollector(doc).OfClass(Material).FirstElementId())
	duplicated.SetCompoundStructure(thecompound)
	trans1.Commit()

	###STEP 2 CREATE WALLS###
	#Revit.Transaction.Transaction.End(doc)
	trans2 = Transaction(doc, 'Inner : Creating Walls')
	trans2.Start()
	foptions = trans2.GetFailureHandlingOptions()
	foptions.SetFailuresPreprocessor(WarnSwallow())
	trans2.SetFailureHandlingOptions(foptions)
	counter = 0
	for c in curves:
		try:
			wallcreate = Wall.Create(doc,c.ToRevitType(),existedwalltype.Id,levelids[counter],heights[counter]*factor,offsets[counter]*factor,False,False)
			param = wallcreate.get_Parameter(BuiltInParameter.WALL_KEY_REF_PARAM).Set(3)
			result.append(wallcreate)
		except:
			pass
		counter += 1
	trans2.Commit()
	#Revit.Transaction.Transaction.End(doc)
	
	if len(result) > 0:
		###STEP 3 SET NEW TYPE###
		trans3 = Transaction(doc, 'Inner : Set to Temporary Wall Type')
		trans3.Start()
		foptions = trans3.GetFailureHandlingOptions()
		foptions.SetFailuresPreprocessor(WarnSwallow())
		trans3.SetFailureHandlingOptions(foptions)
		for e in result:
			try:
				WallUtils.DisallowWallJoinAtEnd(e,0)
				WallUtils.DisallowWallJoinAtEnd(e,1)
				e.ChangeTypeId(duplicated.Id)
			except:
				pass
		trans3.Commit()
		
		Revit.Transaction.Transaction.End(doc)
		###STEP 4 SET EXTERIOR LOCATION LINE###
		trans4 = Transaction(doc, 'Inner : Set Interior Location Line For Walls')
		trans4.Start()
		foptions = trans4.GetFailureHandlingOptions()
		foptions.SetFailuresPreprocessor(WarnSwallow())
		trans4.SetFailureHandlingOptions(foptions)
		for e in result:
			try:
				e.get_Parameter(BuiltInParameter.WALL_KEY_REF_PARAM).Set(2)
			except:
				pass
		trans4.Commit()
		
		#Revit.Transaction.Transaction.End(doc)
		###STEP 5 RESTORE EXISTED TYPE###
		trans5 = Transaction(doc, 'Inner : Restore Correct Wall Type')
		trans5.Start()
		foptions = trans5.GetFailureHandlingOptions()
		foptions.SetFailuresPreprocessor(WarnSwallow())
		trans5.SetFailureHandlingOptions(foptions)
		for e in result:
			try:
				e.ChangeTypeId(existedwalltype.Id)
			except:
				pass
		trans5.Commit()
		
		#Revit.Transaction.Transaction.End(doc)
		###STEP 6 SET WALL CENTERLINE LOCATION LINE###
		trans6 = Transaction(doc, 'Inner : Set Wall Centerline Location Line')
		trans6.Start()
		foptions = trans6.GetFailureHandlingOptions()
		foptions.SetFailuresPreprocessor(WarnSwallow())
		trans6.SetFailureHandlingOptions(foptions)
		for e in result:
			try:
				e.get_Parameter(BuiltInParameter.WALL_KEY_REF_PARAM).Set(0)
				e.Flip()
			except:
				pass
		trans6.Commit()
	
		#Revit.Transaction.Transaction.End(doc)
		###STEP 7 SET INTERIOR LOCATION LINE###
		trans7 = Transaction(doc, 'Inner : Set Interior Location Line')
		trans7.Start()
		foptions = trans7.GetFailureHandlingOptions()
		foptions.SetFailuresPreprocessor(WarnSwallow())
		trans7.SetFailureHandlingOptions(foptions)
		for e in result:
			try:
				e.get_Parameter(BuiltInParameter.WALL_KEY_REF_PARAM).Set(3)
				WallUtils.AllowWallJoinAtEnd(e,0)
				WallUtils.AllowWallJoinAtEnd(e,1)
			except:
				pass
		doc.Delete(duplicated.Id)
		trans7.Commit()
		tGroup.Assimilate()
		# Assign your output to the OUT variable.
		OUT = result
	else:
		trans3 = Transaction(doc, 'Inner : Deleting Temporary Wall Type')
		trans3.Start()
		foptions = trans3.GetFailureHandlingOptions()
		foptions.SetFailuresPreprocessor(WarnSwallow())
		trans3.SetFailureHandlingOptions(foptions)
		doc.Delete(duplicated.Id)	
		trans3.Commit()
		tGroup.Assimilate()
		OUT = None
else:
	OUT = None
# ----------------------------------------
create_3 = List.Create(item0=python_script_3, item1=python_script_2)
code_block_13 = CodeBlock { false; }
clean_7 = List.Clean(list=create_3, preserveIndices=code_block_13)
flatten_5 = List.Flatten(list=clean_7)
k_join_single_list = Custom[K-Join Single List](VARElements=flatten_5)  # package Synthesize toolkit; K-Join Single List
generate_selection_filter = Custom[Generate Selection Filter](VARCreateSelectionFilter=n10_create_selection_filter_for, VARFilterNametoCreate=n11_filter_name_for_pads_outer, VAROverwriteExistingFilter=n13_overwrite_existing_filter, VARElements=python_script_2)  # package Synthesize toolkit; Generate Selection FIlter
generate_selection_filter_2 = Custom[Generate Selection Filter](VARCreateSelectionFilter=n10_create_selection_filter_for, VARFilterNametoCreate=n12_filter_name_for_pads_inner, VAROverwriteExistingFilter=n13_overwrite_existing_filter, VARElements=python_script_3)
