# Dynamo graph Topography.Convert to Family.dyn (Dynamo 2.13.1.3887)
# author: karam@aecedx.com
# packages: Synthesize toolkit 12.5.1

# group: Input
n16_create_selection_filter = BoolSelector(true)  # "16.Create Selection Filter ?"; graph input
n17_filter_name_to_create = StringInput("Dynamo Converted Site")  # "17.Filter Name to Create"; graph input
n18_overwrite_existing_filter = BoolSelector(false)  # "18.Overwrite Existing Filter ? (False for Adding Elements)"; graph input
n03_fetch_active_view_only = BoolSelector(true)  # "03.Fetch Active View Only Elements ?"; graph input
n10_fetch_ceilings = BoolSelector(false)  # "10.Fetch Ceilings ?"; graph input
n06_fetch_floors = BoolSelector(true)  # "06.Fetch Floors ?"; graph input
n11_fetch_generic_models = BoolSelector(false)  # "11.Fetch Generic Models ?"; graph input
n09_fetch_roofs = BoolSelector(false)  # "09.Fetch Roofs ?"; graph input
n08_fetch_columns = BoolSelector(false)  # "08.Fetch Columns ?"; graph input
n07_fetch_walls = BoolSelector(false)  # "07.Fetch Walls ?"; graph input
n05_fetch_building_pads = BoolSelector(true)  # "05.Fetch Building Pads ?"; graph input
n12_fetch_stairs = BoolSelector(false)  # "12.Fetch Stairs ?"; graph input
n04_fetch_topography_mesh = BoolSelector(false)  # "04.Fetch Topography (Mesh)"; graph input
n01_family_name = StringInput("Dynamo Converted Site")  # "01.Family Name"; graph input
n02_family_number_naming_suffix = DoubleInput(1)  # "02.Family Number (Naming Suffix)"; graph input
n13_family_method_category = Categories("OST_Mass")  # "13.Family Method : Category"; graph input
n15_family_method_family_template = Filename("..\..\..\ProgramData\Autodesk\RVT 2020\Family Templates\English\Conceptual Mass\Metric Mass.rft")  # "15.Family Method : Family Template of The Above Category"; graph input
n14_family_method_subcategory = StringInput("")  # "14.Family Method : Subcategory"; graph input

python_script = Python(IN[0]=n03_fetch_active_view_only, IN[1]=n10_fetch_ceilings, IN[2]=n06_fetch_floors, IN[3]=n11_fetch_generic_models, IN[4]=n09_fetch_roofs, IN[5]=n08_fetch_columns, IN[6]=n07_fetch_walls, IN[7]=n05_fetch_building_pads, IN[8]=n12_fetch_stairs, IN[9]=n04_fetch_topography_mesh)  # IronPython2
# ---------- python_script.python (133 lines) ----------
# Created By Karam Baki : karam@aecedx.com
# Enable Python support and load DesignScript library
# IMPORTANT : ALL DYNAMO DESIGN SCRIPT NODES ARE AS (dg)
import clr
import math
clr.AddReference('ProtoGeometry')
from Autodesk.DesignScript import Geometry as dg

# EXTENSION Enable ToDSType
clr.AddReference('RevitNodes')
import Revit
clr.ImportExtensions(Revit.Elements)

# Enable Revit Elements
from Revit.Elements import *

# EXTENSION Enable Geometry Conversion Methods
clr.ImportExtensions(Revit.GeometryConversion)

# Enable Revit API
clr.AddReference('RevitAPI')
from Autodesk.Revit.DB import *

# Enable DocumentManager and TransactionManager
clr.AddReference('RevitServices')
from RevitServices.Persistence import DocumentManager
from RevitServices.Transactions import TransactionManager

# Enable ICollection List Translate
clr.AddReference("System")
import System.Collections.Generic
from System.Collections.Generic import List
from itertools import compress
from itertools import combinations
#The inputs to this node will be stored as a list in the IN variables.

doc = DocumentManager.Instance.CurrentDBDocument
uidoc = DocumentManager.Instance.CurrentUIApplication.ActiveUIDocument
uiapp = DocumentManager.Instance.CurrentUIApplication
app = uiapp.Application

def flatten(x):
    result = []
    for el in x:
        if hasattr(el, "__iter__") and not isinstance(el, basestring):
            result.extend(flatten(el))
        else:
            result.append(el)
    return result

result=[]
Activeonly = IN[0]

if IN[1] == True:
	if Activeonly == True:
		result.append(FilteredElementCollector(doc,doc.ActiveView.Id).OfCategory(BuiltInCategory.OST_Ceilings).WhereElementIsNotElementType().ToElements())
	else:
		result.append(FilteredElementCollector(doc).OfCategory(BuiltInCategory.OST_Ceilings).WhereElementIsNotElementType().ToElements())

if IN[2] == True:
	if Activeonly == True:
		result.append(FilteredElementCollector(doc,doc.ActiveView.Id).OfCategory(BuiltInCategory.OST_Floors).WhereElementIsNotElementType().ToElements())
	else:
		result.append(FilteredElementCollector(doc).OfCategory(BuiltInCategory.OST_Floors).WhereElementIsNotElementType().ToElements())

if IN[3] == True:
	if Activeonly == True:
		result.append(FilteredElementCollector(doc,doc.ActiveView.Id).OfCategory(BuiltInCategory.OST_GenericModel).WhereElementIsNotElementType().ToElements())
	else:
		result.append(FilteredElementCollector(doc).OfCategory(BuiltInCategory.OST_GenericModel).WhereElementIsNotElementType().ToElements())

if IN[4] == True:
	if Activeonly == True:
		result.append(FilteredElementCollector(doc,doc.ActiveView.Id).OfCategory(BuiltInCategory.OST_Roofs).WhereElementIsNotElementType().ToElements())
	else:
		result.append(FilteredElementCollector(doc).OfCategory(BuiltInCategory.OST_Roofs).WhereElementIsNotElementType().ToElements())

if IN[5] == True:
	if Activeonly == True:
		result.append(FilteredElementCollector(doc,doc.ActiveView.Id).OfCategory(BuiltInCategory.OST_StructuralColumns).WhereElementIsNotElementType().ToElements())
		result.append(FilteredElementCollector(doc,doc.ActiveView.Id).OfCategory(BuiltInCategory.OST_Columns).WhereElementIsNotElementType().ToElements())
	else:
		result.append(FilteredElementCollector(doc).OfCategory(BuiltInCategory.OST_StructuralColumns).WhereElementIsNotElementType().ToElements())
		result.append(FilteredElementCollector(doc).OfCategory(BuiltInCategory.OST_Columns).WhereElementIsNotElementType().ToElements())

if IN[6] == True:
	if Activeonly == True:
		walls = FilteredElementCollector(doc,doc.ActiveView.Id).OfCategory(BuiltInCategory.OST_Walls).WhereElementIsNotElementType().ToElements()
		filteredwalls = [getattr(w, 'CurtainGrid', None) is None for w in walls]
		result.append(list(compress(walls, filteredwalls)))
	else:
		walls = FilteredElementCollector(doc).OfCategory(BuiltInCategory.OST_Walls).WhereElementIsNotElementType().ToElements()
		filteredwalls = [getattr(w, 'CurtainGrid', None) is None for w in walls]
		result.append(list(compress(walls, filteredwalls)))

if IN[7] == True:
	if Activeonly == True:
		result.append(FilteredElementCollector(doc,doc.ActiveView.Id).OfCategory(BuiltInCategory.OST_BuildingPad).WhereElementIsNotElementType().ToElements())
	else:
		result.append(FilteredElementCollector(doc).OfCategory(BuiltInCategory.OST_BuildingPad).WhereElementIsNotElementType().ToElements())

if IN[8] == True:
	if Activeonly == True:
		result.append(FilteredElementCollector(doc,doc.ActiveView.Id).OfCategory(BuiltInCategory.OST_Stairs).WhereElementIsNotElementType().ToElements())
	else:
		result.append(FilteredElementCollector(doc).OfCategory(BuiltInCategory.OST_Stairs).WhereElementIsNotElementType().ToElements())

if IN[8] == True:
	if Activeonly == True:
		stairs = list(FilteredElementCollector(doc,doc.ActiveView.Id).OfCategory(BuiltInCategory.OST_Stairs).WhereElementIsNotElementType().ToElements())
	else:
		stairs = list(FilteredElementCollector(doc).OfCategory(BuiltInCategory.OST_Stairs).WhereElementIsNotElementType().ToElements())
	supports = []
	for s in stairs:
		if hasattr(s, 'GetStairsSupports'):
			supportsid = s.GetStairsSupports()
			for sup in supportsid:		
				supports.append(doc.GetElement(sup))
		else:
			break
	result.append(flatten(supports))

toporesult = []
if IN[9] == True:
	if Activeonly == True:
		toporesult.append(FilteredElementCollector(doc,doc.ActiveView.Id).OfCategory(BuiltInCategory.OST_Topography).WhereElementIsNotElementType().ToElements())
	else:
		toporesult.append(FilteredElementCollector(doc).OfCategory(BuiltInCategory.OST_Topography).WhereElementIsNotElementType().ToElements())

elements = flatten(result)
toporesult = flatten(toporesult)

OUT = elements,toporesult
# ----------------------------------------
code_block = CodeBlock(a=python_script) { a[0]; a[1]; }
element_geometry_fast = Custom[Element.Geometry Fast](VARElements=code_block.out0)  # package Synthesize toolkit; Element.Geometry Fast
code_block_2 = CodeBlock { false; }
polySurface = Custom[ZK.Topography.PolySurface](VARTopography=code_block.out1, VARJointoPolysurface=code_block_2)  # package Synthesize toolkit; Convert topography element to polysurface
create = List.Create(item0=element_geometry_fast, item1=polySurface.VARPolySurface)
code_block_3 = CodeBlock { false; }
clean = List.Clean(list=create, preserveIndices=code_block_3)
flatten = List.Flatten(list=clean)
code_block_4 = CodeBlock { false; }
k_family_insert = Custom[K-Family Insert](VARGeometryorSAT=flatten, VARAvoidConfilct=code_block_4, VARFamilyName=n01_family_name, VARFamilyNumber=n02_family_number_naming_suffix, VARFamilyCategory=n13_family_method_category, VARFamilyTemplatePath=n15_family_method_family_template, VARSubcategory=n14_family_method_subcategory, VARSelfOrigin=code_block_4)  # package Synthesize toolkit; K-Family Insert
generate_selection_filter = Custom[Generate Selection Filter](VARCreateSelectionFilter=n16_create_selection_filter, VARFilterNametoCreate=n17_filter_name_to_create, VAROverwriteExistingFilter=n18_overwrite_existing_filter, VARElements=k_family_insert.VARFamilyInstancesOrImportSymbols)  # package Synthesize toolkit; Generate Selection FIlter
debug_python_no_message = Custom[Debug Python No Message]()  # package Synthesize toolkit; Debug Python
