# Dynamo graph Topography.K-Contour Model Create With Perimeter Helping Curves.dyn (Dynamo 2.13.1.3887)
# author: karam@aecedx.com
# packages: Synthesize toolkit 12.5.1

# group: Input
n08_proceed = BoolSelector(false)  # "08.Proceed ?"; graph input
n04_minimum_segments_safty_value = DoubleInput(5)  # "04.Minimum Segments (Safty Value)"; graph input
n03_segments_distance = DoubleInput(3)  # "03.Segments Distance"; graph input
topography = DSModelElementSelection()  # "01.Topography"; nothing selected; graph input
n02_perimeter_helping_curves = DSModelElementsSelection()  # "02.Perimeter Helping Curves"; nothing selected; graph input
n09_export_to_sat = BoolSelector(false)  # "09.Export To SAT ?"; graph input
n10_sat_export_path = StringInput("D:\Exported Stepped Topography.sat")  # "10.SAT Export Path"; graph input
n05_family_name = StringInput("Dynamo Topography Stepped")  # "05.Family Name"; graph input
category = Categories("OST_GenericModel")  # "06.Category"; graph input
n07_family_template_rft = Filename("..\..\..\ProgramData\Autodesk\RVT 2020\Family Templates\English\Metric Generic Model.rft")  # "07.Family Template (.rft)"; graph input

empty = List.Empty()
code_block = CodeBlock { true; }
contour_model_create_with_helper = Custom[Contour Model Create With Helper Curves](VARMinimumSegments=n04_minimum_segments_safty_value, VARSegmentsDistance=n03_segments_distance, VARTopography=topography, VARProceed=n08_proceed, VARHelperCurves=n02_perimeter_helping_curves, VARSegmentLines=code_block, VARSmoothLines=code_block, VARGoWithGeom=code_block)  # package Synthesize toolkit; Contour Model Create
string = StringInput("You are good to go, please activate proceed.")
string_2 = StringInput("""There's a problem, please fix all the contour lines
You can proceed anyway, but expect some missing parts.""")
scopeIf = Custom[CW.ScopeIf+](VARtest=contour_model_create_with_helper.VARIsThereProblem, VARtrue=string, VARfalse=string_2)  # package Synthesize toolkit; A (hopefully) more robust implementation of ScopeIf. Tests a single boolean and returns a value accordingly.
scopeIf_2 = Custom[CW.ScopeIf+](VARtest=n08_proceed, VARtrue=empty, VARfalse=scopeIf)
bk_popup_message_box = Custom[BK.Popup Message Box](VARmessage=scopeIf_2)  # package Synthesize toolkit; from Dynamo Player samples
debug_python = Custom[Debug Python]()  # package Synthesize toolkit; Debug Python
empty_2 = List.Empty()
scopeIf_3 = Custom[CW.ScopeIf+](VARtest=n09_export_to_sat, VARtrue=contour_model_create_with_helper.VARSolid, VARfalse=empty_2)
scopeIf_4 = Custom[CW.ScopeIf+](VARtest=n09_export_to_sat, VARtrue=n10_sat_export_path, VARfalse=empty_2)
exportToSAT = Geometry.ExportToSAT(geometry=scopeIf_3, filePath=scopeIf_4)
k_family_insert = Custom[K-Family Insert](VARGeometryorSAT=contour_model_create_with_helper.VARSolid, VARFamilyName=n05_family_name, VARFamilyCategory=category, VARFamilyTemplatePath=n07_family_template_rft, VARMaterialName=n05_family_name)  # package Synthesize toolkit; K-Family Insert
python_script = Python(IN[0]=k_family_insert.VARFamilyInstancesOrImportSymbols)  # IronPython2
# ---------- python_script.python (79 lines) ----------
# Enable Python support and load DesignScript library
# IMPORTANT : ALL DYNAMO DESIGN SCRIPT NODES ARE AS (dg)
import clr
clr.AddReference('ProtoGeometry')
from Autodesk.DesignScript import Geometry as dg

# EXTENSION Enable ToDSType
clr.AddReference('RevitNodes')
import Revit
clr.ImportExtensions(Revit.Elements)

# Enable Revit Elements
from Revit.Elements import *

# EXTENSION Enable Geometry Conversion Methods
clr.ImportExtensions(Revit.GeometryConversion)

# Enable Revit API
clr.AddReference('RevitAPI')
from Autodesk.Revit.DB import *

# Enable DocumentManager and TransactionManager
clr.AddReference('RevitServices')
from RevitServices.Persistence import DocumentManager
from RevitServices.Transactions import TransactionManager

# Enable ICollection List Translate
clr.AddReference("System")
import System.Collections.Generic
from System.Collections.Generic import List

clr.AddReference("RevitAPIUI")
from Autodesk.Revit.UI import TaskDialog

def tolist(obj1):
	if hasattr(obj1,'__iter__'): return obj1
	else: return [obj1]

def flatten(x):
    result = []
    for el in x:
        if hasattr(el, "__iter__") and not isinstance(el, basestring):
            result.extend(flatten(el))
        else:
            result.append(el)
    return result

dataEnteringNode = IN
# Use UnwrapElement(IN[0]) When Translating From Dynamo to Revit
topo=UnwrapElement(flatten(tolist(IN[0])))[0]

# Choose The Current Document
doc = DocumentManager.Instance.CurrentDBDocument
uidoc = DocumentManager.Instance.CurrentUIApplication.ActiveUIDocument
uiapp = DocumentManager.Instance.CurrentUIApplication
app = uiapp.Application

try:
	# Create Empty List
	result = []
	opt = Options()
	try:
		count = list(list(topo.get_Geometry(opt))[0].GetInstanceGeometry())
	except:
		pass
	
	family = topo.Symbol.Family.Id
	
	if len(count) > 10:
		TransactionManager.Instance.EnsureInTransaction(doc)
		doc.Delete(topo.Id)
		doc.Delete(family)
		TaskDialog.Show("AECedx - Karam", "K-Contour failed, please try increasing 'Segments Distance' to 6 or more")
		OUT = "ERROR"
		TransactionManager.Instance.TransactionTaskDone()
	else:
		OUT = "All Good"
except:
	OUT = "Nothing to Do"
# ----------------------------------------
