# Dynamo graph Topography.K-Contour Model Lines Generate By SAT File With Voids.dyn (Dynamo 2.13.1.3887)
# author: karam@aecedx.com
# packages: Synthesize toolkit 12.5.1

# group: Input
n01_sat_file = Filename("No file selected.")  # "01.SAT File"; graph input
n02_select_void_elements = DSModelElementsSelection()  # "02.Select Void Elements"; nothing selected; graph input
n05_spacing_between_pieces_in = DoubleInput(20)  # "05.Spacing Between Pieces In Drafting View"; graph input
n04_drafting_view_name = StringInput("K-Contour")  # "04.Drafting View Name"; graph input
n03_contour_lines_interval = DoubleInput(5)  # "03.Contour Lines Interval"; graph input

better_geometry_importfromsat = Custom[Better Geometry.ImportFromSAT](VARSATFile=n01_sat_file)  # package Synthesize toolkit; Better Geometry.ImportFromSAT
code_block = CodeBlock { "Solid"; }
byClassName = Custom[SP.Filter.ByClassName](VARobject=better_geometry_importfromsat, VARclassName=code_block)  # package Synthesize toolkit; Filters a list of objects by the object's class name. Note that Dynamo elements belong to different classes than their Revit counterparts. Use the Object.Class node to check an object's class.
element_geometry_fixer = Custom[Element.Geometry Fixer](VARElement=n02_select_void_elements)  # package Synthesize toolkit; Element.Geometry Fixer
flatten = List.Flatten(list=element_geometry_fixer)
differenceAll = Solid.DifferenceAll(solid=byClassName.VARin, others=flatten)
contour_model_lines = Custom[Contour Model Lines](VARSolid=differenceAll, VARSpacing=n05_spacing_between_pieces_in, VARDraftingViewName=n04_drafting_view_name, VARContourLineInterval=n03_contour_lines_interval)  # package Synthesize toolkit; Contour Model Lines
debug_python = Custom[Debug Python]()  # package Synthesize toolkit; Debug Python
