# Dynamo graph Topography.K-Contour Model Lines Generate By SAT File.dyn (Dynamo 2.13.1.3887)
# author: karam@aecedx.com
# packages: Synthesize toolkit 12.5.1

# group: Input
n01_sat_file = Filename("No file selected.")  # "01.SAT File"; graph input
n04_spacing_between_pieces_in = DoubleInput(20)  # "04.Spacing Between Pieces In Drafting View"; graph input
n03_drafting_view_name = StringInput("K-Contour")  # "03.Drafting View Name"; graph input
n02_contour_lines_interval = DoubleInput(5)  # "02.Contour Lines Interval"; graph input

better_geometry_importfromsat = Custom[Better Geometry.ImportFromSAT](VARSATFile=n01_sat_file)  # package Synthesize toolkit; Better Geometry.ImportFromSAT
code_block = CodeBlock { "Solid"; }
byClassName = Custom[SP.Filter.ByClassName](VARobject=better_geometry_importfromsat, VARclassName=code_block)  # package Synthesize toolkit; Filters a list of objects by the object's class name. Note that Dynamo elements belong to different classes than their Revit counterparts. Use the Object.Class node to check an object's class.
contour_model_lines = Custom[Contour Model Lines](VARSolid=byClassName.VARin, VARSpacing=n04_spacing_between_pieces_in, VARDraftingViewName=n03_drafting_view_name, VARContourLineInterval=n02_contour_lines_interval)  # package Synthesize toolkit; Contour Model Lines
debug_python = Custom[Debug Python]()  # package Synthesize toolkit; Debug Python
