# Dynamo graph Topography.K-Contour Model Lines Generate By Selection.dyn (Dynamo 2.13.1.3887)
# author: karam@aecedx.com
# packages: Synthesize toolkit 12.5.1

# group: Input
n01_select_contour_model = DSModelElementSelection()  # "01.Select Contour Model"; nothing selected; graph input
n04_spacing_between_pieces_in = DoubleInput(20)  # "04.Spacing Between Pieces In Drafting View"; graph input
n03_drafting_view_name = StringInput("K-Contour")  # "03.Drafting View Name"; graph input
n02_contour_lines_interval = DoubleInput(5)  # "02.Contour Lines Interval"; graph input

expect_solid_only = Custom[Expect Solid Only](VARElement=n01_select_contour_model)  # package Synthesize toolkit; Expect Solid Only
contour_model_lines = Custom[Contour Model Lines](VARSolid=expect_solid_only, VARSpacing=n04_spacing_between_pieces_in, VARDraftingViewName=n03_drafting_view_name, VARContourLineInterval=n02_contour_lines_interval)  # package Synthesize toolkit; Contour Model Lines
debug_python = Custom[Debug Python]()  # package Synthesize toolkit; Debug Python
