# Dynamo graph Topography.Misc Buildings Infraworks Floors Create.dyn (Dynamo 2.13.1.3887)
# author: karam@aecedx.com
# packages: Synthesize toolkit 12.5.1

# group: Input
n01_select_model_elements = DSModelElementsSelection()  # "01.Select Model Elements"; nothing selected; graph input
n03_height_of_level = DoubleInput(4)  # "03.Height of Level"; graph input
n04_maximum_levels = DoubleInput(100)  # "04.Maximum Levels"; graph input
n05_floor_types = FloorTypes()  # "05.Floor Types"; nothing selected; graph input
n06_use_all_levels_ignores_levels = BoolSelector(true)  # "06.Use All Levels (Ignores Levels Selection Filter)"; graph input
n07_levels_selection_filter_to = StringInput("Levels Filter Name")  # "07.Levels Selection Filter to Read"; graph input
offset = DoubleInput(0)  # "02.Offset"; graph input
n08_create_selection_filter = BoolSelector(true)  # "08.Create Selection Filter ?"; graph input
n09_filter_name_to_create = StringInput("Dynamo Floors By Infraworks Masses")  # "09.Filter Name to Create"; graph input
n10_overwrite_existing_filter = BoolSelector(false)  # "10.Overwrite Existing Filter ? (False for Adding Elements)"; graph input

geometry = Element.Geometry(element=n01_select_model_elements)
flatten = List.Flatten(list=geometry)
explode = Geometry.Explode(geometry=flatten)
filterByOrientation = Custom[CW.Surface.FilterByOrientation](VARsurfaces=explode)  # package Synthesize toolkit; Sorts surfaces in three lists based on their orientation (vertical, horizontal up & horizontal down) and also returns three corresponding lists of booleans.
flatten_2 = List.Flatten(list=filterByOrientation.VARhorizontalDown)
ZAxis = Vector.ZAxis()
code_block = CodeBlock { 0; }
pointAtParameter = Surface.PointAtParameter(surface=filterByOrientation.VARhorizontalDown)
XYZ = Custom[LF.Point.XYZ](VARpoint=pointAtParameter)  # package Synthesize toolkit; Get the X, Y, and Z components of a Point
byCoordinates = Point.ByCoordinates(z=XYZ.VARZ)
pointAtParameter_2 = Surface.PointAtParameter(surface=filterByOrientation.VARhorizontalUp)
XYZ_2 = Custom[LF.Point.XYZ](VARpoint=pointAtParameter_2)
byCoordinates_2 = Point.ByCoordinates(z=XYZ_2.VARZ)
byStartPointEndPoint = Line.ByStartPointEndPoint(startPoint=byCoordinates, endPoint=byCoordinates_2)
flatten_3 = List.Flatten(list=byStartPointEndPoint)
length = Curve.Length(curve=flatten_3)
div = length / n03_height_of_level
floor = Math.Floor(number=div)
lt = n04_maximum_levels < _  # unwired: y
replaceByCondition = Replace(item=floor, replaceWith=n04_maximum_levels, condition=lt)
sequence = Sequence(start=code_block, amount=replaceByCondition, step=n03_height_of_level, lacing=Longest)
translate = Geometry.Translate(geometry=flatten_2, direction=ZAxis, distance=sequence)
perimeterCurves = Surface.PerimeterCurves(surface=translate)
flatten_4 = List.Flatten(list=perimeterCurves@L2)
as_polycurve_bycurves = Custom[AS.[&] PolyCurve.ByCurves](VARcurves=flatten_4@L2)  # package Synthesize toolkit; Create polycurves from an unordered list of curves.
fix_factor_depends_of_project = DoubleInput(1000)  # "Fix Factor (Depends of Project Units, 1 For meters for example, and 100 for Centimeters)"
create_floors_by_boundary_lines = Custom[Create Floors By Boundary Lines (Smart)](VARFloorsBoundariesPolycurves=as_polycurve_bycurves.VARpolyCurve, VARFloorType=n05_floor_types, VARUseAllLevelsIgnoresLevelsSelectionFilter=n06_use_all_levels_ignores_levels, VARFixFactorDependsofProjectUnits1Formetersforexampleand100forCentimeters=fix_factor_depends_of_project, VARLevelsSelectionFiltertoRead=n07_levels_selection_filter_to, VAROffset=offset)  # package Synthesize toolkit; Create Floors By Boundary Lines (Smart)
n01_number_of_floors_created = Watch(create_floors_by_boundary_lines.VARNumberofFloorsCreated)  # "01.Number of Floors Created"; graph output
generate_selection_filter = Custom[Generate Selection Filter](VARCreateSelectionFilter=n08_create_selection_filter, VARFilterNametoCreate=n09_filter_name_to_create, VAROverwriteExistingFilter=n10_overwrite_existing_filter, VARElements=create_floors_by_boundary_lines.VARFloors)  # package Synthesize toolkit; Generate Selection FIlter
debug_python = Custom[Debug Python]()  # package Synthesize toolkit; Debug Python
