# Dynamo graph Topography.Misc Contour Smooth.dyn (Dynamo 2.13.1.3887)
# author: karam@aecedx.com
# packages: Synthesize toolkit 12.5.1

# group: Input
n04_delete_old = BoolSelector(true)  # "04.Delete Old ?"; graph input
n01_select_topography = DSModelElementSelection()  # "01.Select Topography"; nothing selected; graph input
smoothness = DoubleInput(25)  # "02.Smoothness"; graph input
n03_distance_between_points = DoubleInput(5)  # "03.Distance Between Points ?"; graph input

select_topography_from_subregion = Custom[Select Topography From Subregion](VARTopography=n01_select_topography)  # package Synthesize toolkit; Select Topography From Subregion
code_block = CodeBlock { true; }
polySurface = Custom[ZK.Topography.PolySurface](VARTopography=select_topography_from_subregion, VAROnlyCurves=code_block)  # package Synthesize toolkit; Convert topography element to polysurface
python_script = Python(IN[0]=polySurface.VARPolyCurves, IN[1]=smoothness)  # IronPython2
# ---------- python_script.python (65 lines) ----------
# Created By Karam Baki : karam@aecedx.com
# Enable Python support and load DesignScript library
# IMPORTANT : ALL DYNAMO DESIGN SCRIPT NODES ARE AS (dg)
import clr
import math
clr.AddReference('ProtoGeometry')
from Autodesk.DesignScript import Geometry as dg

# EXTENSION Enable ToDSType
clr.AddReference('RevitNodes')
import Revit
clr.ImportExtensions(Revit.Elements)

# Enable Revit Elements
from Revit.Elements import *

# EXTENSION Enable Geometry Conversion Methods
clr.ImportExtensions(Revit.GeometryConversion)

# Enable Revit API
clr.AddReference('RevitAPI')
from Autodesk.Revit.DB import *

# Enable DocumentManager and TransactionManager
clr.AddReference('RevitServices')
from RevitServices.Persistence import DocumentManager
from RevitServices.Transactions import TransactionManager

# Enable ICollection List Translate
clr.AddReference("System")
import System.Collections.Generic
from System.Collections.Generic import List
from System import Array
from array import array
#The inputs to this node will be stored as a list in the IN variables.

doc = DocumentManager.Instance.CurrentDBDocument
uidoc = DocumentManager.Instance.CurrentUIApplication.ActiveUIDocument
uiapp = DocumentManager.Instance.CurrentUIApplication
app = uiapp.Application

def flatten(x):
    result = []
    for el in x:
        if hasattr(el, "__iter__") and not isinstance(el, basestring):
            result.extend(flatten(el))
        else:
            result.append(el)
    return result

inside = UnwrapElement(IN[0])
distance = IN[1]

result=[]

lengths = []
for e in inside:
	num = round(e.Length/distance)
	if num < 4:
		num = range(4)
		lengths.append(num)
	else:
		lengths.append(range(int(num)))

OUT = lengths
# ----------------------------------------
code_block_2 = CodeBlock { 0; 1; }
remapRange = Math.RemapRange(numbers=python_script, newMin=code_block_2.out0, newMax=code_block_2.out1)
python_script_2 = Python(IN[0]=polySurface.VARPolyCurves, IN[1]=remapRange)  # IronPython2
# ---------- python_script_2.python (73 lines) ----------
# Created By Karam Baki : karam@aecedx.com
# Enable Python support and load DesignScript library
# IMPORTANT : ALL DYNAMO DESIGN SCRIPT NODES ARE AS (dg)
import clr
import math
clr.AddReference('ProtoGeometry')
from Autodesk.DesignScript import Geometry as dg

# EXTENSION Enable ToDSType
clr.AddReference('RevitNodes')
import Revit
clr.ImportExtensions(Revit.Elements)

# Enable Revit Elements
from Revit.Elements import *

# EXTENSION Enable Geometry Conversion Methods
clr.ImportExtensions(Revit.GeometryConversion)

# Enable Revit API
clr.AddReference('RevitAPI')
from Autodesk.Revit.DB import *
import Autodesk.Revit.DB
# Enable DocumentManager and TransactionManager
clr.AddReference('RevitServices')
from RevitServices.Persistence import DocumentManager
from RevitServices.Transactions import TransactionManager

# Enable ICollection List Translate
clr.AddReference("System")
import System.Collections.Generic
from System.Collections.Generic import List
from System import Array
from array import array
#The inputs to this node will be stored as a list in the IN variables.

doc = DocumentManager.Instance.CurrentDBDocument
uidoc = DocumentManager.Instance.CurrentUIApplication.ActiveUIDocument
uiapp = DocumentManager.Instance.CurrentUIApplication
app = uiapp.Application

def flatten(x):
    result = []
    for el in x:
        if hasattr(el, "__iter__") and not isinstance(el, basestring):
            result.extend(flatten(el))
        else:
            result.append(el)
    return result

inside = UnwrapElement(IN[0])
nums = IN[1]

result=[]

count = 0
for each in inside:
	try:
		tmp = []
		for e in nums[count]:
			tmp.append(dg.Curve.PointAtParameter(each,e))
		closedornot = each.IsClosed
		if closedornot == True:
			tmp.pop(-1)
		cu = dg.NurbsCurve.ByControlPoints(tmp,3,closedornot)
		result.append(cu)
		count = count + 1
	except:
		count = count + 1

result = flatten(result)

OUT = result
# ----------------------------------------
python_script_3 = Python(IN[0]=python_script_2, IN[1]=n03_distance_between_points)  # IronPython2; same code as python_script
remapRange_2 = Math.RemapRange(numbers=python_script_3, newMin=code_block_2.out0, newMax=code_block_2.out1)
python_script_4 = Python(IN[0]=python_script_2, IN[1]=remapRange_2)  # IronPython2
# ---------- python_script_4.python (95 lines) ----------
# Created By Karam Baki : karam@aecedx.com
# Enable Python support and load DesignScript library
# IMPORTANT : ALL DYNAMO DESIGN SCRIPT NODES ARE AS (dg)
import clr
import math
clr.AddReference('ProtoGeometry')
from Autodesk.DesignScript import Geometry as dg

# EXTENSION Enable ToDSType
clr.AddReference('RevitNodes')
import Revit
clr.ImportExtensions(Revit.Elements)

# Enable Revit Elements
from Revit.Elements import *

# EXTENSION Enable Geometry Conversion Methods
clr.ImportExtensions(Revit.GeometryConversion)

# Enable Revit API
clr.AddReference('RevitAPI')
from Autodesk.Revit.DB import *
import Autodesk.Revit.DB
# Enable DocumentManager and TransactionManager
clr.AddReference('RevitServices')
from RevitServices.Persistence import DocumentManager
from RevitServices.Transactions import TransactionManager

# Enable ICollection List Translate
clr.AddReference("System")
import System.Collections.Generic
from System.Collections.Generic import List
from System import Array
from array import array
#The inputs to this node will be stored as a list in the IN variables.

doc = DocumentManager.Instance.CurrentDBDocument
uidoc = DocumentManager.Instance.CurrentUIApplication.ActiveUIDocument
uiapp = DocumentManager.Instance.CurrentUIApplication
app = uiapp.Application

def flatten(x):
    result = []
    for el in x:
        if hasattr(el, "__iter__") and not isinstance(el, basestring):
            result.extend(flatten(el))
        else:
            result.append(el)
    return result

inside = UnwrapElement(IN[0])
nums = IN[1]

result=[]

count = 0
for each in inside:	
	tmp = []
	for e in nums[count]:
		tmp.append(dg.Curve.PointAtParameter(each,e))
	closedornot = each.IsClosed
	if closedornot == True:
		tmp.pop(-1)
	result.append(tmp)
	count = count + 1

result = flatten(result)

def p2t(p) : return round(p.X,4), round(p.Y,4), round(p.Z,4)

pts = map(p2t, result)
unique_pts = set(pts)
if not True:
	same_z = [(i[:2],i[-1]) for i in unique_pts]
	same_z.sort(key = itemgetter(0) )
	unique_pts = []
	for k, g in groupby(same_z, itemgetter(0) ):
		coord = list(k)
		coord.append(max([i[-1] for i in g]) )
		unique_pts.append(coord)
pruned = [dg.Point.ByCoordinates(*i) for i in unique_pts]

xyznow = []
for e in pruned:
	xyznow.append(e.ToXyz())

coords = List[Autodesk.Revit.DB.XYZ](xyznow)

TransactionManager.Instance.EnsureInTransaction(doc)

topo = Architecture.TopographySurface.Create(doc,coords)

TransactionManager.Instance.TransactionTaskDone()

OUT = topo
# ----------------------------------------
passthrough = Custom[CW.Passthrough](VARpassThrough=select_topography_from_subregion, VARwaitFor=python_script_4)  # package Synthesize toolkit; Forces a sequential order of execution. The node wired into the output of the Passthrough node will be executed *after* the node wired into the waitFor input (e.g. important for some Revit operations). The value of the passThrough input will be passed on to the node wired into the output port of the Passthrough node.
empty = List.Empty()
scopeIf = Custom[CW.ScopeIf+](VARtest=n04_delete_old, VARtrue=passthrough, VARfalse=empty)  # package Synthesize toolkit; A (hopefully) more robust implementation of ScopeIf. Tests a single boolean and returns a value accordingly.
code_block_3 = CodeBlock { false; }
clean = List.Clean(list=scopeIf, preserveIndices=code_block_3)
flatten = List.Flatten(list=clean)
eraser = Custom[ST.Tool.Eraser](VARList=flatten)  # package Synthesize toolkit; Try to delete any element from project
debug_python = Custom[Debug Python]()  # package Synthesize toolkit; Debug Python
