# Dynamo graph Topography.Misc Lines of Intersect Generate.dyn (Dynamo 2.13.1.3887)
# author: karam@aecedx.com
# packages: Synthesize toolkit 12.5.1

# group: Input
n05_create_selection_filter_of = BoolSelector(true)  # "05.Create Selection Filter of Lines ?"; graph input
n06_filter_name_of_lines = StringInput("Dynamo Topo Intersected Lines")  # "06.Filter Name Of Lines"; graph input
n07_overwrite_existing_filter = BoolSelector(false)  # "07.Overwrite Existing Filter ? (False for Adding Elements)"; graph input
n02_select_elements = DSModelElementsSelection()  # "02.Select Elements"; nothing selected; graph input
n01_select_topography = DSModelElementsSelection()  # "01.Select Topography"; nothing selected; graph input
linestyle = StringInput("Thin Lines")  # "03.Linestyle"; graph input
n04_pin_lines = BoolSelector(true)  # "04.Pin Lines ?"; graph input

topography_lines_of_intersects = Custom[Topography Lines of Intersects](VARElements=n02_select_elements, VARTopography=n01_select_topography)  # package Synthesize toolkit; Topography Lines of Intersects
generate_selection_filter = Custom[Generate Selection Filter](VARCreateSelectionFilter=n05_create_selection_filter_of, VARFilterNametoCreate=n06_filter_name_of_lines, VAROverwriteExistingFilter=n07_overwrite_existing_filter, VARElements=topography_lines_of_intersects)  # package Synthesize toolkit; Generate Selection FIlter
code_block = CodeBlock { false; }
clean = List.Clean(list=topography_lines_of_intersects, preserveIndices=code_block)
code_block_2 = CodeBlock { "Line Style"; }
element_types = ElementTypes("GraphicsStyle")
all_elements_of_type = ElementsOfType(element_type=element_types)
name = Element.Name(element=all_elements_of_type)
default_linestyles_name_revit = Custom[Default Linestyles Name Revit Compatiblity](VARLinestylename=linestyle)  # package Synthesize toolkit; Default Linestyles Name Revit Compatiblity
eq = name == default_linestyles_name_revit
filterByBoolMask = List.FilterByBoolMask(list=all_elements_of_type, mask=eq)
firstItem = List.FirstItem(list=filterByBoolMask.in)
setParameterByName = Element.SetParameterByName(element=clean, parameterName=code_block_2, value=firstItem)
setPinnedStatus = Custom[RH.Element.SetPinnedStatus](VARelement=topography_lines_of_intersects, VARBool=n04_pin_lines)  # package Synthesize toolkit; Will set the element to either pinned or not pinned. True is pinned, false is unpinned. For multiple elements use List.Map
debug_python = Custom[Debug Python]()  # package Synthesize toolkit; Debug Python
