# Dynamo graph Topography.Misc Pull Lines Onto Topo.dyn (Dynamo 2.13.1.3887)
# author: karam@aecedx.com
# packages: Synthesize toolkit 12.5.1

# group: Input
n05_create_selection_filter_of = BoolSelector(true)  # "05.Create Selection Filter of Lines ?"; graph input
n06_filter_name_of_lines = StringInput("Dynamo Generated Lines")  # "06.Filter Name Of Lines"; graph input
n07_overwrite_existing_filter = BoolSelector(false)  # "07.Overwrite Existing Filter ? (False for Adding Elements)"; graph input
n02_select_lines = DSModelElementsSelection()  # "02.Select Lines"; nothing selected; graph input
n01_select_topography = DSModelElementSelection()  # "01.Select Topography"; nothing selected; graph input
n03_number_of_control_points = DoubleInput(100)  # "03.Number of Control Points Desired"; graph input
n04_delete_old = BoolSelector(true)  # "04.Delete Old ?"; graph input

topography_pull_lines_onto_topo = Custom[Topography Pull Lines Onto Topo](VARCurves=n02_select_lines, VARTopography=n01_select_topography, VARNumberofControlPointsDesired=n03_number_of_control_points)  # package Synthesize toolkit; Topography Pull Lines Onto Topo
generate_selection_filter = Custom[Generate Selection Filter](VARCreateSelectionFilter=n05_create_selection_filter_of, VARFilterNametoCreate=n06_filter_name_of_lines, VAROverwriteExistingFilter=n07_overwrite_existing_filter, VARElements=topography_pull_lines_onto_topo)  # package Synthesize toolkit; Generate Selection FIlter
passthrough = Custom[CW.Passthrough](VARpassThrough=n02_select_lines, VARwaitFor=topography_pull_lines_onto_topo)  # package Synthesize toolkit; Forces a sequential order of execution. The node wired into the output of the Passthrough node will be executed *after* the node wired into the waitFor input (e.g. important for some Revit operations). The value of the passThrough input will be passed on to the node wired into the output port of the Passthrough node.
code_block = CodeBlock { null; false; }
scopeIf = Custom[CW.ScopeIf+](VARtest=n04_delete_old, VARtrue=passthrough, VARfalse=code_block.out0)  # package Synthesize toolkit; A (hopefully) more robust implementation of ScopeIf. Tests a single boolean and returns a value accordingly.
clean = List.Clean(list=scopeIf, preserveIndices=code_block.out1)
flatten = List.Flatten(list=clean)
eraser = Custom[ST.Tool.Eraser](VARList=flatten)  # package Synthesize toolkit; Try to delete any element from project
debug_python = Custom[Debug Python]()  # package Synthesize toolkit; Debug Python
