# Dynamo graph Topography.Misc Scale.dyn (Dynamo 2.13.1.3887)
# author: karam@aecedx.com
# packages: Synthesize toolkit 12.5.1

# group: Input
n05_new_y = DoubleInput(1)  # "05.New Y"; graph input
n04_old_y = DoubleInput(1)  # "04.Old Y"; graph input
n03_new_x = DoubleInput(1)  # "03.New X"; graph input
n02_old_x = DoubleInput(1)  # "02.Old X"; graph input
n07_new_z = DoubleInput(1)  # "07.New Z"; graph input
n06_old_z = DoubleInput(1)  # "06.Old Z"; graph input
n01_select_topography = DSModelElementSelection()  # "01.Select Topography"; nothing selected; graph input

select_topography_from_subregion = Custom[Select Topography From Subregion](VARTopography=n01_select_topography)  # package Synthesize toolkit; Select Topography From Subregion
points = Topography.Points(topography=select_topography_from_subregion)
topography_scale_points = Custom[Topography Scale Points](VARNewY=n05_new_y, VAROldY=n04_old_y, VARNewX=n03_new_x, VAROldX=n02_old_x, VARNewZ=n07_new_z, VAROldZ=n06_old_z, VARTopographyPoints=points)  # package Synthesize toolkit; Generate Scaled Lines
debug_python = Custom[Debug Python]()  # package Synthesize toolkit; Debug Python
