# Dynamo graph Topography.Misc Split Unlock.dyn (Dynamo 2.13.1.3887)
# author: karam@aecedx.com
# packages: Synthesize toolkit 12.5.1

note = StringInput("""1- Run once without Proceed
2- Ctrl + C
3- Run with Proceed
4- Align to Same place""")  # "03.Note"; graph input

# group: Input
n01_select_topography = DSModelElementSelection()  # "01.Select Topography"; nothing selected; graph input
n02_proceed_only_after_you_copied = BoolSelector(false)  # "02.Proceed (Only After you copied the selected elements from first play)"; graph input

topography_split_unlock = Custom[Topography Split Unlock](VARTopography=n01_select_topography, VARProceedOnlyAfteryoucopiedtheselectedelementsfromfirstplay=n02_proceed_only_after_you_copied)  # package Synthesize toolkit; Topography Split Allow
debug_python = Custom[Debug Python]()  # package Synthesize toolkit; Debug Python
