# Dynamo graph Topography.Misc Water By Custom Boundary.dyn (Dynamo 2.13.1.3887)
# author: karam@aecedx.com
# packages: Synthesize toolkit 12.5.1

debug_python = Custom[Debug Python]()  # package Synthesize toolkit; Debug Python

# group: Input
n01_select_water_boundaries = DSModelElementsSelection()  # "01.Select Water Boundaries"; nothing selected; graph input
n09_water_depth = DoubleInput(30)  # "09.Water Depth"; graph input
n08_water_level = Levels("Level 1")  # "08.Water Level"; graph input
n02_select_topography = DSModelElementSelection()  # "02.Select Topography"; nothing selected; graph input
n03_build_subregion_bellow_water = BoolSelector(true)  # "03.Build Subregion Bellow Water"; graph input
n04_family_name = StringInput("Dynamo Water Family")  # "04.Family Name"; graph input
n06_family_category = Categories("OST_GenericModel")  # "06.Family Category"; graph input
n07_family_template = Filename("..\..\..\..\..\..\..\..\..\..\ProgramData\Autodesk\RVT 2020\Family Templates\English\Metric Generic Model.rft")  # "07.Family Template"; graph input
n05_water_material = StringInput("Water")  # "05.Water Material"; graph input

curves = Element.Curves(element=n01_select_water_boundaries)
flatten = List.Flatten(list=curves)
as_polycurve_bycurves = Custom[AS.[&] PolyCurve.ByCurves](VARcurves=flatten)  # package Synthesize toolkit; Create polycurves from an unordered list of curves.
curves_2 = PolyCurve.Curves(polyCurve=as_polycurve_bycurves.VARpolyCurve)
simplify = Custom[SP.CurveLoop.Simplify](VARcurveLoop=curves_2)  # package Synthesize toolkit; Attempts to simplify an open or a closed curve loop by connecting straight separate line segments into a single line.
as_polycurve_bycurves_2 = Custom[AS.[&] PolyCurve.ByCurves](VARcurves=simplify@L2)
code_block = CodeBlock { true; }
polySurface = Custom[ZK.Topography.PolySurface](VARTopography=n02_select_topography, VARFullTopo=code_block)  # package Synthesize toolkit; Convert topography element to polysurface
topography_water = Custom[Topography Water](VARWaterBoundary=as_polycurve_bycurves_2.VARpolyCurve, VARWaterDepth=n09_water_depth, VARWaterLevel=n08_water_level, VARTopographyPolysurface=polySurface.VARPolySurface, VARTopography=n02_select_topography, VARBuildSubregionBellowWateer=n03_build_subregion_bellow_water)  # package Synthesize toolkit; Topography Water
k_family_insert = Custom[K-Family Insert](VARGeometryorSAT=topography_water, VARFamilyName=n04_family_name, VARFamilyCategory=n06_family_category, VARFamilyTemplatePath=n07_family_template, VARMaterialName=n05_water_material)  # package Synthesize toolkit; K-Family Insert
