# Dynamo graph Topography.Pads By Contour Lines Create With Perimeter Helping Curves.dyn (Dynamo 2.13.1.3887)
# author: karam@aecedx.com
# packages: Synthesize toolkit 12.5.1

debug_python = Custom[Debug Python]()  # package Synthesize toolkit; Debug Python

# group: Input
n04_segment_lines = BoolSelector(true)  # "04.Segment Lines ?"; graph input
n06_minimum_segments_safty_value = DoubleInput(5)  # "06.Minimum Segments (Safty Value)"; graph input
n05_segments_distance = DoubleInput(3)  # "05.Segments Distance"; graph input
n01_select_subregion = DSModelElementSelection()  # "01.Select Subregion"; nothing selected; graph input
n02_perimeter_helping_curves = DSModelElementsSelection()  # "02.Perimeter Helping Curves"; nothing selected; graph input
n03_number_of_control_points = DoubleInput(5)  # "03.Number of Control Points Desired (Per Contour Line)"; graph input
use_all_levels_ignores_levels = BoolSelector(true)  # "Use All Levels (Ignores Levels Selection Filter)"
levels_selection_filter_to_read = StringInput("Levels Filter Name")
n07_building_pad_type = StringInput("Pad 1")  # "07.Building Pad Type"; graph input
n08_height_offset = DoubleInput(0)  # "08.Height Offset"; graph input
n09_create_selection_filter_for = BoolSelector(true)  # "09.Create Selection Filter for Auto Pads"; graph input
n10_filter_name_for_auto_pads = StringInput("Dynamo Pads By Contour Lines")  # "10.Filter Name for Auto Pads"; graph input
n11_overwrite_existing_filter = BoolSelector(false)  # "11.Overwrite Existing Filter ? (False for Adding Elements)"; graph input

code_block = CodeBlock { true; false; }
contour_model_create_with_helper = Custom[Contour Model Create With Helper Curves](VARMinimumSegments=n06_minimum_segments_safty_value, VARSegmentsDistance=n05_segments_distance, VARTopography=n01_select_subregion, VARProceed=code_block.out0, VARHelperCurves=n02_perimeter_helping_curves, VARSegmentLines=n04_segment_lines, VARPointsDistancing=n03_number_of_control_points, VARSmoothLines=code_block.out0, VARGoWithGeom=code_block.out1)  # package Synthesize toolkit; Contour Model Create
translate = Geometry.Translate(geometry=contour_model_create_with_helper.VARCurves, zTranslation=contour_model_create_with_helper.VARHeights)
curves = PolyCurve.Curves(polyCurve=translate)
simplify = Custom[SP.CurveLoop.Simplify](VARcurveLoop=curves)  # package Synthesize toolkit; Attempts to simplify an open or a closed curve loop by connecting straight separate line segments into a single line.
byJoinedCurves = PolyCurve.ByJoinedCurves(curves=simplify)
scopeIf = Custom[CW.ScopeIf+](VARtest=n04_segment_lines, VARtrue=byJoinedCurves, VARfalse=translate)  # package Synthesize toolkit; A (hopefully) more robust implementation of ScopeIf. Tests a single boolean and returns a value accordingly.
code_block_2 = CodeBlock { 0.001; }
create_pads_by_boundary_lines = Custom[Create Pads By Boundary Lines (Smart)](VARPadsBoundariesPolycurves=scopeIf, VARUseAllLevelsIgnoresLevelsSelectionFilter=use_all_levels_ignores_levels, VARLevelsSelectionFiltertoRead=levels_selection_filter_to_read, VARPadType=n07_building_pad_type, VAROffset=n08_height_offset, VAROffsetRounding=code_block_2)  # package Synthesize toolkit; Create Floors By Boundary Lines (Smart)

# group: Result
n01_number_of_pads_created = Watch(create_pads_by_boundary_lines.VARNumberofPadsCreated)  # "01.Number of Pads Created"; graph output

generate_selection_filter = Custom[Generate Selection Filter](VARCreateSelectionFilter=n09_create_selection_filter_for, VARFilterNametoCreate=n10_filter_name_for_auto_pads, VAROverwriteExistingFilter=n11_overwrite_existing_filter, VARElements=create_pads_by_boundary_lines.VARPads)  # package Synthesize toolkit; Generate Selection FIlter
