# Dynamo graph Topography.Pads By Elements Selection.dyn (Dynamo 2.13.1.3887)
# author: karam@aecedx.com
# packages: Synthesize toolkit 12.5.1

debug_python = Custom[Debug Python]()  # package Synthesize toolkit; Debug Python

# group: Input
n05_create_selection_filter_for = BoolSelector(true)  # "05.Create Selection Filter for Pads"; graph input
n06_filter_name_for_pads = StringInput("Dynamo Pads By Faces Selection")  # "06.Filter Name for Pads"; graph input
n07_overwrite_existing_filter = BoolSelector(false)  # "07.Overwrite Existing Filter ? (False for Adding Elements)"; graph input
n03_building_pad_type = StringInput("Pad 1")  # "03.Building Pad Type"; graph input
n04_height_offset = DoubleInput(0)  # "04.Height Offset"; graph input
n01_select_elements = DSModelElementsSelection()  # "01.Select Elements"; nothing selected; graph input
n02_method_1_horizontal_up_faces = IntegerSlider(2, range=1..3 step 1)  # "02.Method (1 = Horizontal Up Faces | 2 = Horizontal Down Faces | 3 = Both Faces)"; graph input

element_geometry_fixer = Custom[Element.Geometry Fixer](VARElement=n01_select_elements)  # package Synthesize toolkit; Element.Geometry Fixer
explode = Geometry.Explode(geometry=element_geometry_fixer)
flatten = List.Flatten(list=explode)
code_block = CodeBlock { "Surface"; }
byClassName = Custom[SP.Filter.ByClassName](VARobject=flatten, VARclassName=code_block)  # package Synthesize toolkit; Filters a list of objects by the object's class name. Note that Dynamo elements belong to different classes than their Revit counterparts. Use the Object.Class node to check an object's class.
python_script = Python(IN[0]=n02_method_1_horizontal_up_faces)  # IronPython2
# ---------- python_script.python (13 lines) ----------
import clr
clr.AddReference('ProtoGeometry')
from Autodesk.DesignScript.Geometry import *
#The inputs to this node will be stored as a list in the IN variables.
dataEnteringNode = IN

method = IN[0]
if method == 1:
	OUT = 2
elif method == 2:
	OUT = 3
else:
	OUT = 23
# ----------------------------------------
surface_orientation_filter = Custom[Surface Orientation Filter](VARSurfaces=byClassName.VARin, VAROrienataion=python_script)  # package Synthesize toolkit; Face Filter
flatten_2 = List.Flatten(list=surface_orientation_filter.VARSurfaces)
join_adjacent_surfaces = Custom[Join Adjacent Surfaces](VARSurfaces=flatten_2)  # package Synthesize toolkit; Join Adjacent Surfaces
perimeterCurves = Surface.PerimeterCurves(surface=join_adjacent_surfaces)
pads_by_lists_of_curves = Custom[Pads By Lists of Curves](VARBuildingPadType=n03_building_pad_type, VARHeightOffset=n04_height_offset, VARListsofCurves=perimeterCurves)  # package Synthesize toolkit; Pads By Lists of Curves
generate_selection_filter = Custom[Generate Selection Filter](VARCreateSelectionFilter=n05_create_selection_filter_for, VARFilterNametoCreate=n06_filter_name_for_pads, VAROverwriteExistingFilter=n07_overwrite_existing_filter, VARElements=pads_by_lists_of_curves.VARPads)  # package Synthesize toolkit; Generate Selection FIlter
