# Dynamo graph Topography.Pads By Faces Selection.dyn (Dynamo 2.13.1.3887)
# author: karam@aecedx.com
# packages: Synthesize toolkit 12.5.1

debug_python = Custom[Debug Python]()  # package Synthesize toolkit; Debug Python

# group: Input
n05_create_selection_filter_for = BoolSelector(true)  # "05.Create Selection Filter for Pads"; graph input
n06_filter_name_for_pads = StringInput("Dynamo Pads By Faces Selection")  # "06.Filter Name for Pads"; graph input
n07_overwrite_existing_filter = BoolSelector(false)  # "07.Overwrite Existing Filter ? (False for Adding Elements)"; graph input
n03_building_pad_type = StringInput("Pad 1")  # "03.Building Pad Type"; graph input
n04_height_offset = DoubleInput(0)  # "04.Height Offset"; graph input
n02_method_1_horizontal_up_faces = IntegerSlider(2, range=1..3 step 1)  # "02.Method (1 = Horizontal Up Faces | 2 = Horizontal Down Faces | 3 = All Faces)"; graph input
n01_select_faces = SelectFaces()  # "01.Select Faces"; nothing selected; graph input

code_block = CodeBlock { 3; 1; 2; null; false; }
eq = n02_method_1_horizontal_up_faces == code_block.out0
flatten = List.Flatten(list=n01_select_faces)
scopeIf = Custom[CW.ScopeIf+](VARtest=eq, VARtrue=flatten, VARfalse=code_block.out3)  # package Synthesize toolkit; A (hopefully) more robust implementation of ScopeIf. Tests a single boolean and returns a value accordingly.
eq_2 = n02_method_1_horizontal_up_faces == code_block.out1
filterByOrientation = Custom[CW.Surface.FilterByOrientation](VARsurfaces=flatten)  # package Synthesize toolkit; Sorts surfaces in three lists based on their orientation (vertical, horizontal up & horizontal down) and also returns three corresponding lists of booleans.
scopeIf_2 = Custom[CW.ScopeIf+](VARtest=eq_2, VARtrue=filterByOrientation.VARhorizontalUp, VARfalse=code_block.out3)
eq_3 = n02_method_1_horizontal_up_faces == code_block.out2
scopeIf_3 = Custom[CW.ScopeIf+](VARtest=eq_3, VARtrue=filterByOrientation.VARhorizontalDown, VARfalse=code_block.out3)
create = List.Create(item0=scopeIf, item1=scopeIf_2, item2=scopeIf_3)
clean = List.Clean(list=create, preserveIndices=code_block.out4)
flatten_2 = List.Flatten(list=clean)
code_block_2 = CodeBlock { false; }
join_adjacent_surfaces = Custom[Join Adjacent Surfaces](VARSurfaces=flatten_2, VARNormalsCheck=code_block_2)  # package Synthesize toolkit; Join Adjacent Surfaces
perimeterCurves = Surface.PerimeterCurves(surface=join_adjacent_surfaces)
pads_by_lists_of_curves = Custom[Pads By Lists of Curves](VARBuildingPadType=n03_building_pad_type, VARHeightOffset=n04_height_offset, VARListsofCurves=perimeterCurves)  # package Synthesize toolkit; Pads By Lists of Curves
generate_selection_filter = Custom[Generate Selection Filter](VARCreateSelectionFilter=n05_create_selection_filter_for, VARFilterNametoCreate=n06_filter_name_for_pads, VAROverwriteExistingFilter=n07_overwrite_existing_filter, VARElements=pads_by_lists_of_curves.VARPads)  # package Synthesize toolkit; Generate Selection FIlter
