# Dynamo graph Topography.Pads By Floors.dyn (Dynamo 2.13.1.3887)
# author: karam@aecedx.com
# packages: Synthesize toolkit 12.5.1

# group: Input
n03_boundary_offset = DoubleInput(0)  # "03.Boundary Offset"; graph input
n05_create_selection_filter_for = BoolSelector(true)  # "05.Create Selection Filter for Pads"; graph input
n06_filter_name_for_pads = StringInput("Dynamo Pads By Floors")  # "06.Filter Name for Pads"; graph input
n07_overwrite_existing_filter = BoolSelector(false)  # "07.Overwrite Existing Filter ? (False for Adding Elements)"; graph input
n02_building_pad_type = StringInput("Pad 1")  # "02.Building Pad Type"; graph input
n04_height_offset = DoubleInput(-0.3)  # "04.Height Offset"; graph input
n01_select_floors = DSModelElementsSelection()  # "01.Select Floors"; nothing selected; graph input

code_block = CodeBlock { "Floor"; }
byClassName = Custom[SP.Filter.ByClassName](VARobject=n01_select_floors, VARclassName=code_block)  # package Synthesize toolkit; Filters a list of objects by the object's class name. Note that Dynamo elements belong to different classes than their Revit counterparts. Use the Object.Class node to check an object's class.
elementSketch = Custom[SP.Collector.ElementSketch](VARelement=byClassName.VARin)  # package Synthesize toolkit; Get the actual sketch lines of a sketch based element (floor, ceiling, modified wall, etc.) . You can optionally fetch the matching model curves, however this might prove comptationally heavy on larger data sets.
flatten = List.Flatten(list=elementSketch.VARcurves@L3)
pads_by_lists_of_curves = Custom[Pads By Lists of Curves](VARBuildingPadType=n02_building_pad_type, VARHeightOffset=n04_height_offset, VARListsofCurves=flatten)  # package Synthesize toolkit; Pads By Lists of Curves
generate_selection_filter = Custom[Generate Selection Filter](VARCreateSelectionFilter=n05_create_selection_filter_for, VARFilterNametoCreate=n06_filter_name_for_pads, VAROverwriteExistingFilter=n07_overwrite_existing_filter, VARElements=pads_by_lists_of_curves.VARPads)  # package Synthesize toolkit; Generate Selection FIlter
debug_python = Custom[Debug Python]()  # package Synthesize toolkit; Debug Python
