# Dynamo graph Topography.Pads By Rooms With AI or Human Attractor.dyn (Dynamo 2.13.1.3887)
# author: karam@aecedx.com
# packages: Synthesize toolkit 12.5.1

debug_python = Custom[Debug Python]()  # package Synthesize toolkit; Debug Python

# group: Input
n06_create_selection_filter_for = BoolSelector(true)  # "06.Create Selection Filter for Auto Pads"; graph input
n07_filter_name_for_auto_pads = StringInput("Dynamo Pads By Rooms")  # "07.Filter Name for Auto Pads"; graph input
n08_overwrite_existing_filter = BoolSelector(false)  # "08.Overwrite Existing Filter ? (False for Adding Elements)"; graph input
n02_select_attractors = DSModelElementsSelection()  # "02.Select Attractors"; nothing selected; graph input
n04_building_pad_type = StringInput("Pad 1")  # "04.Building Pad Type"; graph input
n03_method_false_auto_ai_true = BoolSelector(true)  # "03.Method : False = Auto AI | True = Human Attractors"; graph input
n01_select_rooms_at_level = Levels()  # "01.Select Rooms At Level"; nothing selected; graph input
levels_selection_filter_to_read = StringInput("Levels Filter Name")
use_all_levels_ignores_levels = BoolSelector(true)  # "Use All Levels (Ignores Levels Selection Filter)"
n05_height_offset = DoubleInput(0)  # "05.Height Offset"; graph input
n09_slow_motion_debugging_purpose = BoolSelector(false)  # "09.Slow Motion (Debugging Purpose)"; graph input

auto_pads_by_rooms = Custom[Auto Pads By Rooms](VARAttractors=n02_select_attractors, VARBuildingPadTypeName=n04_building_pad_type, VARMethodFalseAutoAITrueHumanAttractors=n03_method_false_auto_ai_true, VARSelectRoomsAtLevel=n01_select_rooms_at_level, VARLevelsSelectionFiltertoRead=levels_selection_filter_to_read, VARUseAllLevels=use_all_levels_ignores_levels, VARHeightOffset=n05_height_offset, VARSlowMotion=n09_slow_motion_debugging_purpose)  # package Synthesize toolkit; Auto Pads By Rooms
generate_selection_filter = Custom[Generate Selection Filter](VARCreateSelectionFilter=n06_create_selection_filter_for, VARFilterNametoCreate=n07_filter_name_for_auto_pads, VAROverwriteExistingFilter=n08_overwrite_existing_filter, VARElements=auto_pads_by_rooms.VARBuildingPads)  # package Synthesize toolkit; Generate Selection FIlter
