# Dynamo graph Topography.Pads By Walls.dyn (Dynamo 2.13.1.3887)
# author: karam@aecedx.com
# packages: Synthesize toolkit 12.5.1

debug_python = Custom[Debug Python]()  # package Synthesize toolkit; Debug Python

# group: Input
n04_create_selection_filter_for = BoolSelector(true)  # "04.Create Selection Filter for Pads"; graph input
n05_filter_name_for_pads = StringInput("Dynamo Pads By Walls")  # "05.Filter Name for Pads"; graph input
n06_overwrite_existing_filter = BoolSelector(false)  # "06.Overwrite Existing Filter ? (False for Adding Elements)"; graph input
n02_building_pad_type = StringInput("Pad 1")  # "02.Building Pad Type"; graph input
n03_height_offset = DoubleInput(0)  # "03.Height Offset"; graph input
n01_select_walls = DSModelElementsSelection()  # "01.Select Walls"; nothing selected; graph input

code_block = CodeBlock { "Wall"; }
byClassName = Custom[SP.Filter.ByClassName](VARobject=n01_select_walls, VARclassName=code_block)  # package Synthesize toolkit; Filters a list of objects by the object's class name. Note that Dynamo elements belong to different classes than their Revit counterparts. Use the Object.Class node to check an object's class.
element_geometry_fixer = Custom[Element.Geometry Fixer](VARElement=byClassName.VARin)  # package Synthesize toolkit; Element.Geometry Fixer
flatten = List.Flatten(list=element_geometry_fixer)
explode = Geometry.Explode(geometry=flatten)
filterByOrientation = Custom[CW.Surface.FilterByOrientation](VARsurfaces=explode)  # package Synthesize toolkit; Sorts surfaces in three lists based on their orientation (vertical, horizontal up & horizontal down) and also returns three corresponding lists of booleans.
code_block_2 = CodeBlock { 0.5; }
pointAtParameter = Surface.PointAtParameter(surface=filterByOrientation.VARhorizontalDown, u=code_block_2, v=code_block_2)
Z = Point.Z(point=pointAtParameter)
minimumItem = List.MinimumItem(list=Z)
eq = Z == minimumItem
filterByBoolMask = List.FilterByBoolMask(list=filterByOrientation.VARhorizontalDown, mask=eq)
flatten_2 = List.Flatten(list=filterByBoolMask.in)
code_block_3 = CodeBlock { false; }
join_adjacent_surfaces = Custom[Join Adjacent Surfaces](VARSurfaces=flatten_2, VARNormalsCheck=code_block_3)  # package Synthesize toolkit; Join Adjacent Surfaces
perimeterCurves = Surface.PerimeterCurves(surface=join_adjacent_surfaces)
pads_by_lists_of_curves = Custom[Pads By Lists of Curves](VARBuildingPadType=n02_building_pad_type, VARHeightOffset=n03_height_offset, VARListsofCurves=perimeterCurves)  # package Synthesize toolkit; Pads By Lists of Curves
generate_selection_filter = Custom[Generate Selection Filter](VARCreateSelectionFilter=n04_create_selection_filter_for, VARFilterNametoCreate=n05_filter_name_for_pads, VAROverwriteExistingFilter=n06_overwrite_existing_filter, VARElements=pads_by_lists_of_curves.VARPads)  # package Synthesize toolkit; Generate Selection FIlter
