# Dynamo graph Topography.Pads Combine.dyn (Dynamo 2.13.1.3887)
# author: karam@aecedx.com
# packages: Synthesize toolkit 12.5.1

debug_python = Custom[Debug Python]()  # package Synthesize toolkit; Debug Python

# group: Input
n01_select_pads_to_combine = DSModelElementsSelection()  # "01.Select Pads to Combine"; nothing selected; graph input

string_from_object = FromObject(obj=n01_select_pads_to_combine)
code_block = CodeBlock { "BuildingPad"; }
eq = string_from_object == code_block
filterByBoolMask = List.FilterByBoolMask(list=n01_select_pads_to_combine, mask=eq)
element_geometry_fixer = Custom[Element.Geometry Fixer](VARElement=filterByBoolMask.in)  # package Synthesize toolkit; Element.Geometry Fixer
explode = Geometry.Explode(geometry=element_geometry_fixer)
filterByOrientation = Custom[CW.Surface.FilterByOrientation](VARsurfaces=explode)  # package Synthesize toolkit; Sorts surfaces in three lists based on their orientation (vertical, horizontal up & horizontal down) and also returns three corresponding lists of booleans.
flatten = List.Flatten(list=filterByOrientation.VARhorizontalUp)
join_adjacent_surfaces = Custom[Join Adjacent Surfaces](VARSurfaces=flatten)  # package Synthesize toolkit; Join Adjacent Surfaces
perimeterCurves = Surface.PerimeterCurves(surface=join_adjacent_surfaces)
as_polycurve_bycurves = Custom[AS.[&] PolyCurve.ByCurves](VARcurves=perimeterCurves)  # package Synthesize toolkit; Create polycurves from an unordered list of curves.
code_block_2 = CodeBlock { false; }
clean = List.Clean(list=as_polycurve_bycurves.VARpolyCurve, preserveIndices=code_block_2)
curves = PolyCurve.Curves(polyCurve=clean)
curves_offset_to_revit = Custom[Curves Offset To Revit Compatibility](VARCurves=curves@L3)  # package Synthesize toolkit; Curves Offset To Revit Compatibility
code_block_3 = CodeBlock { true; }
code_block_4 = CodeBlock { 1; 0.01; 0; }
categories = Categories("OST_Levels")
all_elements_of_category = ElementsOfCategory(Category=categories)
firstItem = List.FirstItem(list=curves@L3)
firstItem_2 = List.FirstItem(list=firstItem@L2)
startPoint = Curve.StartPoint(curve=firstItem_2)
detect_levels_of_points = Custom[Detect Levels of Points](VARSetOffsetParameter=code_block_3, VARRoundingValue=code_block_4.out1, VARRoundingFix=code_block_3, VARFixFactorDependsofProjectUnits1Formetersforexampleand100forCentimeters=code_block_4.out0, VARLevels=all_elements_of_category, VARPoints=startPoint, VARZLocationOffset=code_block_4.out2)  # package Synthesize toolkit; Detect Levels of Points From Family Refine Levels and Offset
python_script = Python(IN[0]=curves_offset_to_revit.VARRevitCurves, IN[1]=detect_levels_of_points.VARLevelsSet, IN[2]=filterByBoolMask.in)  # IronPython2
# ---------- python_script.python (82 lines) ----------
import clr
#Import Revit Services
clr.AddReference ("RevitServices")
import RevitServices
from RevitServices.Persistence import DocumentManager
from RevitServices.Transactions import TransactionManager
#Import Revit API
clr.AddReference('RevitAPI')
from Autodesk.Revit.DB import *
from Autodesk.Revit.DB.Architecture import *
clr.AddReference('RevitAPIUI')
from Autodesk.Revit.UI import *
#Import Revit Node
clr.AddReference('RevitNodes')
import Revit
clr.ImportExtensions(Revit.GeometryConversion)
clr.ImportExtensions(Revit.Elements)
#Import Proto Geometry
clr.AddReference('ProtoGeometry')
from Autodesk.DesignScript import Geometry as dg

import System
from System.Collections.Generic import *

def tolist(obj1):
	if hasattr(obj1,'__iter__'): return obj1
	else: return [obj1]
	
def flatten(x):
    result = []
    for el in x:
        if hasattr(el, "__iter__") and not isinstance(el, basestring):
            result.extend(flatten(el))
        else:
            result.append(el)
    return result
	
dataEnteringNode = IN
# Use UnwrapElement(IN[0]) When Translating From Dynamo to Revit
padsbounds=UnwrapElement(tolist(IN[0]))
leveltoselect = UnwrapElement(IN[1])
oldpads = UnwrapElement(IN[2])


# Choose The Current Document
doc = DocumentManager.Instance.CurrentDBDocument
uidoc = DocumentManager.Instance.CurrentUIApplication.ActiveUIDocument
uiapp = DocumentManager.Instance.CurrentUIApplication
app = uiapp.Application

# Create Empty List
result = []

TransactionManager.Instance.EnsureInTransaction(doc)	

counter = 0
for r in padsbounds:
	typeId = oldpads[counter].GetTypeId()
	try:
		currentlevelID = leveltoselect[counter].Id
		#Check loops in each room
		all_loops = []
		for each in r:
			tmploops = CurveLoop()
			#Check line in each loop
			for e in each:
				tmploops.Append(e)
			all_loops.append(tmploops)
		result.append(BuildingPad.Create(doc,typeId,currentlevelID,all_loops))
	except:
		result.append(None)
	counter += 1

for p in oldpads:
	try:
		doc.Delete(p.Id)
	except: pass

TransactionManager.Instance.TransactionTaskDone()

# Assign your output to the OUT variable
OUT = result
# ----------------------------------------
isNull = Object.IsNull(object=python_script)
filterByBoolMask_2 = List.FilterByBoolMask(list=python_script, mask=isNull)
code_block_5 = CodeBlock { "Height Offset From Level"; "Level"; }
filterByBoolMask_3 = List.FilterByBoolMask(list=detect_levels_of_points.VARElevationsSet, mask=isNull)
setParameterByName = Element.SetParameterByName(element=filterByBoolMask_2.out, parameterName=code_block_5.out0, value=filterByBoolMask_3.out)
filterByBoolMask_4 = List.FilterByBoolMask(list=detect_levels_of_points.VARLevelsSet, mask=isNull)
setParameterByName_2 = Element.SetParameterByName(element=filterByBoolMask_2.out, parameterName=code_block_5.out1, value=filterByBoolMask_4.out)
