# Dynamo graph Topography.Pads Offset.dyn (Dynamo 2.13.1.3887)
# author: karam@aecedx.com
# packages: Synthesize toolkit 12.5.1

debug_python = Custom[Debug Python]()  # package Synthesize toolkit; Debug Python

# group: Input
n01_select_pads = DSModelElementsSelection()  # "01.Select Pads"; nothing selected; graph input
n02_boundary_offset = DoubleInput(0.5)  # "02.Boundary Offset"; graph input
n03_height_offset = DoubleInput(0)  # "03.Height Offset"; graph input

code_block = CodeBlock { "BuildingPad"; }
filterByString = Custom[ST.List.FilterByString](VARlist=n01_select_pads, VARString=code_block)  # package Synthesize toolkit; Filter a list by a string match
elementSketch = Custom[SP.Collector.ElementSketch](VARelement=filterByString.VARMatch)  # package Synthesize toolkit; Get the actual sketch lines of a sketch based element (floor, ceiling, modified wall, etc.) . You can optionally fetch the matching model curves, however this might prove comptationally heavy on larger data sets.
as_polycurve_bycurves = Custom[AS.[&] PolyCurve.ByCurves](VARcurves=elementSketch.VARcurves)  # package Synthesize toolkit; Create polycurves from an unordered list of curves.
boundingBox = Geometry.BoundingBox(geometry=as_polycurve_bycurves.VARpolyCurve)
minPoint = BoundingBox.MinPoint(boundingBox=boundingBox)
byOriginNormal = Plane.ByOriginNormal(origin=minPoint)
pullOntoPlane = Curve.PullOntoPlane(curve=as_polycurve_bycurves.VARpolyCurve, plane=byOriginNormal)
curves_offset_to_revit = Custom[Curves Offset To Revit Compatibility](VARCurves=pullOntoPlane@L3, VAROffset=n02_boundary_offset)  # package Synthesize toolkit; Curves Offset To Revit Compatibility
firstItem = List.FirstItem(list=curves_offset_to_revit.VARCurves@L3)
firstItem_2 = List.FirstItem(list=firstItem@L2)
startPoint = Cone.StartPoint(cone=firstItem_2)
code_block_2 = CodeBlock { 1; true; 0.001; 0; }
categories = Categories("OST_Levels")
all_elements_of_category = ElementsOfCategory(Category=categories)
startPoint_2 = Curve.StartPoint(curve=firstItem_2)
detect_levels_of_points = Custom[Detect Levels of Points](VARSetOffsetParameter=code_block_2.out1, VARRoundingValue=code_block_2.out2, VARRoundingFix=code_block_2.out1, VARFixFactorDependsofProjectUnits1Formetersforexampleand100forCentimeters=code_block_2.out0, VARLevels=all_elements_of_category, VARPoints=startPoint_2, VARZLocationOffset=code_block_2.out3)  # package Synthesize toolkit; Detect Levels of Points From Family Refine Levels and Offset
python_script = Python(IN[0]=curves_offset_to_revit.VARRevitCurves, IN[1]=detect_levels_of_points.VARLevelsSet, IN[2]=filterByString.VARMatch)  # IronPython2
# ---------- python_script.python (82 lines) ----------
import clr
#Import Revit Services
clr.AddReference ("RevitServices")
import RevitServices
from RevitServices.Persistence import DocumentManager
from RevitServices.Transactions import TransactionManager
#Import Revit API
clr.AddReference('RevitAPI')
from Autodesk.Revit.DB import *
from Autodesk.Revit.DB.Architecture import *
clr.AddReference('RevitAPIUI')
from Autodesk.Revit.UI import *
#Import Revit Node
clr.AddReference('RevitNodes')
import Revit
clr.ImportExtensions(Revit.GeometryConversion)
clr.ImportExtensions(Revit.Elements)
#Import Proto Geometry
clr.AddReference('ProtoGeometry')
from Autodesk.DesignScript import Geometry as dg

import System
from System.Collections.Generic import *

def tolist(obj1):
	if hasattr(obj1,'__iter__'): return obj1
	else: return [obj1]
	
def flatten(x):
    result = []
    for el in x:
        if hasattr(el, "__iter__") and not isinstance(el, basestring):
            result.extend(flatten(el))
        else:
            result.append(el)
    return result
	
dataEnteringNode = IN
# Use UnwrapElement(IN[0]) When Translating From Dynamo to Revit
padsbounds=UnwrapElement(tolist(IN[0]))
leveltoselect = UnwrapElement(IN[1])
oldpads = UnwrapElement(IN[2])


# Choose The Current Document
doc = DocumentManager.Instance.CurrentDBDocument
uidoc = DocumentManager.Instance.CurrentUIApplication.ActiveUIDocument
uiapp = DocumentManager.Instance.CurrentUIApplication
app = uiapp.Application

# Create Empty List
result = []

TransactionManager.Instance.EnsureInTransaction(doc)	

counter = 0
for r in padsbounds:
	typeId = oldpads[counter].GetTypeId()
	try:
		doc.Delete(oldpads[counter].Id)
	except: pass
	
	try:
		currentlevelID = leveltoselect[counter].Id
		#Check loops in each room
		all_loops = []
		for each in r:
			tmploops = CurveLoop()
			#Check line in each loop
			for e in each:
				tmploops.Append(e)
			all_loops.append(tmploops)
		result.append(BuildingPad.Create(doc,typeId,currentlevelID,all_loops))
	except:
		result.append(None)
	counter += 1


TransactionManager.Instance.TransactionTaskDone()

# Assign your output to the OUT variable
OUT = result
# ----------------------------------------
isNull = Object.IsNull(object=python_script)
filterByBoolMask = List.FilterByBoolMask(list=python_script, mask=isNull)
code_block_3 = CodeBlock { "Height Offset From Level"; "Level"; }
filterByBoolMask_2 = List.FilterByBoolMask(list=detect_levels_of_points.VARElevationsSet, mask=isNull)
add = filterByBoolMask_2.out + n03_height_offset
setParameterByName = Element.SetParameterByName(element=filterByBoolMask.out, parameterName=code_block_3.out0, value=add)
filterByBoolMask_3 = List.FilterByBoolMask(list=detect_levels_of_points.VARLevelsSet, mask=isNull)
setParameterByName_2 = Element.SetParameterByName(element=filterByBoolMask.out, parameterName=code_block_3.out1, value=filterByBoolMask_3.out)
