# Dynamo graph Topography.Pads Thicken For K-Contour.dyn (Dynamo 2.13.1.3887)
# author: karam@aecedx.com
# packages: Synthesize toolkit 12.5.1

debug_python = Custom[Debug Python]()  # package Synthesize toolkit; Debug Python

# group: Input
n05_create_selection_filter = BoolSelector(true)  # "05.Create Selection Filter"; graph input
n06_filter_name = StringInput("Dynamo Thickened Pads")  # "06.Filter Name"; graph input
n07_overwrite_existing_filter = BoolSelector(false)  # "07.Overwrite Existing Filter ? (False for Adding Elements)"; graph input
n01_family_name = StringInput("Dynamo Pads Void")  # "01.Family Name"; graph input
categories = 03.Categories("OST_GenericModel")  # graph input
n04_family_template_rft = Filename("..\..\..\ProgramData\Autodesk\RVT 2020\Family Templates\English\Metric Generic Model.rft")  # "04.Family Template (.rft)"; graph input
n02_to_void = BoolSelector(true)  # "02.To Void"; graph input

element_types = ElementTypes("BuildingPad")
all_elements_of_type = ElementsOfType(element_type=element_types)
flatten = List.Flatten(list=all_elements_of_type)
element_geometry_fixer = Custom[Element.Geometry Fixer](VARElement=flatten)  # package Synthesize toolkit; Element.Geometry Fixer
flatten_2 = List.Flatten(list=element_geometry_fixer)
explode = Geometry.Explode(geometry=flatten_2)
filterByOrientation = Custom[CW.Surface.FilterByOrientation](VARsurfaces=explode)  # package Synthesize toolkit; Sorts surfaces in three lists based on their orientation (vertical, horizontal up & horizontal down) and also returns three corresponding lists of booleans.
python_script = Python(IN[0]=flatten)  # IronPython2
# ---------- python_script.python (74 lines) ----------
# Enable Python support and load DesignScript library
# IMPORTANT : ALL DYNAMO DESIGN SCRIPT NODES ARE AS (dg)
import clr
clr.AddReference('ProtoGeometry')
from Autodesk.DesignScript import Geometry as dg

# EXTENSION Enable ToDSType
clr.AddReference('RevitNodes')
import Revit
clr.ImportExtensions(Revit.Elements)

# Enable Revit Elements
from Revit.Elements import *

# EXTENSION Enable Geometry Conversion Methods
clr.ImportExtensions(Revit.GeometryConversion)

# Enable Revit API
clr.AddReference('RevitAPI')
from Autodesk.Revit.DB import *

# Enable DocumentManager and TransactionManager
clr.AddReference('RevitServices')
from RevitServices.Persistence import DocumentManager
from RevitServices.Transactions import TransactionManager

# Enable ICollection List Translate
clr.AddReference("System")
import System.Collections.Generic
from System.Collections.Generic import List

dataEnteringNode = IN
# Use UnwrapElement(IN[0]) When Translating From Dynamo to Revit

# Choose The Current Document
doc = DocumentManager.Instance.CurrentDBDocument
uidoc = DocumentManager.Instance.CurrentUIApplication.ActiveUIDocument
uiapp = DocumentManager.Instance.CurrentUIApplication
app = uiapp.Application

def tolist(obj1):
	if hasattr(obj1,'__iter__'): return obj1
	else: return [obj1]

def get_topo(doc):
	topos = FilteredElementCollector(doc).OfCategory(BuiltInCategory.OST_Topography).WhereElementIsNotElementType().ToElements()
	bbox = []
	volumes = []
	padsbbox = []
	for e in topos:
		try:
			bb = e.get_BoundingBox(None).ToProtoType()
			bbox.append(bb)
			cub = bb.ToCuboid()
			vol = cub.Volume
			volumes.append(vol)
			cub.Dispose()
		except:
			pass
	maxvol = max(volumes)
	biggest = []
	counter = 0
	for e in volumes:
		if maxvol == e:
			biggest = bbox[counter]
			break
		counter += 1
		
	return biggest

wait = UnwrapElement(IN[0])

# Assign your output to the OUT variable.
OUT = get_topo(doc)
# ----------------------------------------
dimensions = Custom[ZK.BoundingBox.Dimensions](VARBoundingBox=python_script)  # package Synthesize toolkit; Input Bounding Box element to get its dimensions (Width, Length, Height). Setting Boolean switch to True rounds output values.
code_block = CodeBlock { false; }
surface_thicken_fixer = Custom[Surface.Thicken Fixer](VARsurface=filterByOrientation.VARhorizontalUp, VARthickness=dimensions.VARHeight, VARboth_sides=code_block, lacing=Longest)  # package Synthesize toolkit; Surface.Thicken Fixer
flatten_3 = List.Flatten(list=surface_thicken_fixer)
code_block_2 = CodeBlock { false; }
smart_rft_path = Custom[Smart RFT Path](VARRFTFile=n04_family_template_rft, VARCategory=categories)  # package Synthesize toolkit; Smart RFT Path
k_family_insert = Custom[K-Family Insert](VARGeometryorSAT=flatten_3, VAROneFamily=code_block_2, VARFamilyName=n01_family_name, VARFamilyCategory=categories, VARFamilyTemplatePath=smart_rft_path, VARToVoid=n02_to_void)  # package Synthesize toolkit; K-Family Insert
generate_selection_filter = Custom[Generate Selection Filter](VARCreateSelectionFilter=n05_create_selection_filter, VARFilterNametoCreate=n06_filter_name, VAROverwriteExistingFilter=n07_overwrite_existing_filter, VARElements=k_family_insert.VARFamilyInstancesOrImportSymbols)  # package Synthesize toolkit; Generate Selection FIlter
