# Dynamo graph Topography.Site Designer Sidewalks Stitch.dyn (Dynamo 2.13.1.3887)
# author: karam@aecedx.com
# packages: Synthesize toolkit 12.5.1

# group: Input
n02_select_streets_curbs = DSModelElementsSelection()  # "02.Select Streets & Curbs & Sidewalks"; nothing selected; graph input
n03_spacing_between_points_to_add = DoubleInput(0.25)  # "03.Spacing Between Points To Add"; graph input
n01_select_topography = DSModelElementSelection()  # "01.Select Topography"; nothing selected; graph input
n04_nearby_points_cleaning_range = DoubleInput(1)  # "04.Nearby Points Cleaning Range"; graph input

name = Family.Name(family=n02_select_streets_curbs)
code_block = CodeBlock { "Dynamo Sidewalk"; }
contains = String.Contains(string=name, searchFor=code_block)
filterByBoolMask = List.FilterByBoolMask(list=n02_select_streets_curbs, mask=contains)
name_2 = Family.Name(family=filterByBoolMask.out)
code_block_2 = CodeBlock { "Curb"; }
contains_2 = String.Contains(string=name_2, searchFor=code_block_2)
filterByBoolMask_2 = List.FilterByBoolMask(list=filterByBoolMask.out, mask=contains_2)
element_geometry_fixer = Custom[Element.Geometry Fixer](VARElement=filterByBoolMask_2.out)  # package Synthesize toolkit; Element.Geometry Fixer
count = List.Count(list=element_geometry_fixer@L2)
code_block_3 = CodeBlock { 2; }
eq = count == code_block_3
filterByBoolMask_3 = List.FilterByBoolMask(list=element_geometry_fixer, mask=eq)
flatten = List.Flatten(list=filterByBoolMask_3.out)
explode = Geometry.Explode(geometry=flatten)
python_script = Python(IN[0]=explode)  # IronPython2
# ---------- python_script.python (92 lines) ----------
# Enable Python support and load DesignScript library
# IMPORTANT : ALL DYNAMO DESIGN SCRIPT NODES ARE AS (dg)
import clr
clr.AddReference('ProtoGeometry')
from Autodesk.DesignScript import Geometry as dg

# EXTENSION Enable ToDSType
clr.AddReference('RevitNodes')
import Revit
clr.ImportExtensions(Revit.Elements)

# Enable Revit Elements
from Revit.Elements import *

# EXTENSION Enable Geometry Conversion Methods
clr.ImportExtensions(Revit.GeometryConversion)

# Enable Revit API
clr.AddReference('RevitAPI')
from Autodesk.Revit.DB import *

# Enable DocumentManager and TransactionManager
clr.AddReference('RevitServices')
from RevitServices.Persistence import DocumentManager
from RevitServices.Transactions import TransactionManager

# Enable ICollection List Translate
clr.AddReference("System")
import System.Collections.Generic
from System.Collections.Generic import List

dataEnteringNode = IN
# Use UnwrapElement(IN[0]) When Translating From Dynamo to Revit
surflists=UnwrapElement(IN[0])

# Choose The Current Document
doc = DocumentManager.Instance.CurrentDBDocument
uidoc = DocumentManager.Instance.CurrentUIApplication.ActiveUIDocument
uiapp = DocumentManager.Instance.CurrentUIApplication
app = uiapp.Application

# Create Empty List
result = []

count = 0
for eachlist in surflists:
	tmpareas = []
	for each in eachlist:
		tmpareas.append(each.Area)
	maxarea = min(tmpareas)
	ind = tmpareas.IndexOf(maxarea)
	surflists[count].RemoveAt(ind)
	count = count + 1
	
count = 0
for eachlist in surflists:
	tmpareas = []
	for each in eachlist:
		tmpareas.append(each.Area)
	maxarea = min(tmpareas)
	ind = tmpareas.IndexOf(maxarea)
	surflists[count].RemoveAt(ind)
	count = count + 1

count = 0
for eachlist in surflists:
	tmpareas = []
	for each in eachlist:
		tmpareas.append(each.Area)
	maxarea = min(tmpareas)
	ind = tmpareas.IndexOf(maxarea)
	surflists[count].RemoveAt(ind)
	count = count + 1
	
count = 0
for eachlist in surflists:
	tmpareas = []
	for each in eachlist:
		tmpareas.append(each.Area)
	maxarea = min(tmpareas)
	ind = tmpareas.IndexOf(maxarea)
	surflists[count].RemoveAt(ind)
	count = count + 1

# Start a Transaction with Current Document (doc)
TransactionManager.Instance.EnsureInTransaction(doc)

# End the Transaction with Current Document ()
TransactionManager.Instance.TransactionTaskDone()

# Assign your output to the OUT variable.
OUT = surflists
# ----------------------------------------
python_script_2 = Python(IN[0]=python_script)  # IronPython2
# ---------- python_script_2.python (80 lines) ----------
import sys
import clr
clr.AddReference('ProtoGeometry')
from Autodesk.DesignScript.Geometry import *

clr.AddReference('DSCoreNodes')
import DSCore
from DSCore import *

#Import ToDSType(bool) extension method
clr.AddReference("RevitNodes")
import Revit
clr.ImportExtensions(Revit.Elements)

# Import geometry conversion extension methods
clr.ImportExtensions(Revit.GeometryConversion)

# Import DocumentManager and TransactionManager
clr.AddReference("RevitServices")
import RevitServices
from RevitServices.Persistence import DocumentManager
from RevitServices.Transactions import TransactionManager
from System.Collections.Generic import *

# Import RevitAPI
clr.AddReference("RevitAPI")
import Autodesk

#The inputs to this node will be stored as a list in the IN variables.
dataEnteringNode = IN

shapesArray = IN[0]
shapesArrayWithPolySurfaces = []

def polySurfacesFromGeometry (surfacesArray): #this function figures out which surfaces touch each other, making polysurfaces from each set of surfaces that touch each other. 

	resultantPolySurfaceArray = ""
	
	surfacesNotIntersecting = []
	surfaceJoined1 = "" 

	surfacesAlreadyIntersecting = []
	surfaceJoined2 = "" 

	for surface1 in surfacesArray:
		if(len(surfacesAlreadyIntersecting) == 0):
			for surface2 in surfacesArray:
				if(surface1 != surface2):
					if(Geometry.DoesIntersect(surface1, surface2)):
						surfacesAlreadyIntersecting.append(surface1)
						surfacesAlreadyIntersecting.append(surface2)
						surfaceJoined1 = PolySurface.ByJoinedSurfaces(surfacesAlreadyIntersecting)
						break;
		else:
			if surface1 in surfacesAlreadyIntersecting:
				continue;
			if(Geometry.DoesIntersect(surface1, surfaceJoined1)):
						surfacesAlreadyIntersecting.append(surface1)
						surfaceJoined1 = PolySurface.ByJoinedSurfaces(surfacesAlreadyIntersecting)
			else:
				surfacesNotIntersecting.append(surface1)
				surfaceJoined2 = PolySurface.ByJoinedSurfaces(surfacesNotIntersecting)
	#sorting is not thorough enough. come back and make it more robust 
	if(surfaceJoined2 == ""):
		resultantPolySurfaceArray = [surfaceJoined1]
	else:
		if(Geometry.DoesIntersect(surfaceJoined1, surfaceJoined2)):
			singlePolySurface = PolySurface.ByJoinedSurfaces([surfaceJoined1,surfaceJoined2])
			resultantPolySurfaceArray = [singlePolySurface]
		else: 
			resultantPolySurfaceArray = [surfaceJoined1,surfaceJoined2]
	return resultantPolySurfaceArray;
if shapesArray == None:
	pass
else:
	for shape in shapesArray:
		polysurfacesForShape = polySurfacesFromGeometry(shape)
		shapesArrayWithPolySurfaces.append(polysurfacesForShape)

OUT = shapesArrayWithPolySurfaces
# ----------------------------------------
code_block_4 = CodeBlock { 0.5; }
pointAtParameter = Surface.PointAtParameter(surface=python_script_2, u=code_block_4, v=code_block_4)
Z = Point.Z(point=pointAtParameter)
minimumItem = List.MinimumItem(list=Z)
eq_2 = Z == minimumItem
filterByBoolMask_4 = List.FilterByBoolMask(list=python_script_2, mask=eq_2)
surfaces = PolySurface.Surfaces(polySurface=filterByBoolMask_4.in)
perimeterCurves = Surface.PerimeterCurves(surface=surfaces)
flatten_2 = List.Flatten(list=perimeterCurves)
element_geometry_fixer_2 = Custom[Element.Geometry Fixer](VARElement=filterByBoolMask_2.in)
flatten_3 = List.Flatten(list=element_geometry_fixer_2)
explode_2 = Geometry.Explode(geometry=flatten_3)
filterByOrientation = Custom[CW.Surface.FilterByOrientation](VARsurfaces=explode_2)  # package Synthesize toolkit; Sorts surfaces in three lists based on their orientation (vertical, horizontal up & horizontal down) and also returns three corresponding lists of booleans.
area = Surface.Area(surface=filterByOrientation.VARvertical)
maximumItem = List.MaximumItem(list=area)
eq_3 = area == maximumItem
filterByBoolMask_5 = List.FilterByBoolMask(list=filterByOrientation.VARvertical, mask=eq_3)
code_block_5 = CodeBlock { -0.00393701; false; }
unit_types = UnitTypes("Length")
displayUnitType = Custom[CW.UnitType.DisplayUnitType](VARunitType=unit_types)  # package Synthesize toolkit; Retrieves the display unit type for a given unit type.
toDisplayUnit = Custom[CW.InternalUnit.ToDisplayUnit](VARval=code_block_5.out0, VARdisplayUnitType=displayUnitType.VARdisplayUnitType)  # package Synthesize toolkit; Converts a value from Revit's internal unit to a given display unit
thicken = Surface.Thicken(surface=filterByBoolMask_5.in, thickness=toDisplayUnit, both_sides=code_block_5.out1)
explode_3 = Geometry.Explode(geometry=thicken)
code_block_6 = CodeBlock { 1; }
getItemAtIndex = List.GetItemAtIndex(list=explode_3@L2, index=code_block_6)
perimeterCurves_2 = Surface.PerimeterCurves(surface=getItemAtIndex)
length = Curve.Length(curve=perimeterCurves_2)
code_block_7 = CodeBlock { 2; }
round = Math.Round(number=length, digits=code_block_7)
maximumItem_2 = List.MaximumItem(list=round)
eq_4 = round == maximumItem_2
filterByBoolMask_6 = List.FilterByBoolMask(list=perimeterCurves_2, mask=eq_4)
code_block_8 = CodeBlock { 0.5; }
pointAtParameter_2 = Curve.PointAtParameter(curve=filterByBoolMask_6.in, param=code_block_8)
Z_2 = Point.Z(point=pointAtParameter_2)
minimumItem_2 = List.MinimumItem(list=Z_2)
eq_5 = Z_2 == minimumItem_2
filterByBoolMask_7 = List.FilterByBoolMask(list=filterByBoolMask_6.in, mask=eq_5)
flatten_4 = List.Flatten(list=filterByBoolMask_7.in)
perimeterCurves_3 = Surface.PerimeterCurves(surface=filterByBoolMask_5.in)
length_2 = Curve.Length(curve=perimeterCurves_3)
code_block_9 = CodeBlock { 2; }
round_2 = Math.Round(number=length_2, digits=code_block_9)
maximumItem_3 = List.MaximumItem(list=round_2)
eq_6 = round_2 == maximumItem_3
filterByBoolMask_8 = List.FilterByBoolMask(list=perimeterCurves_3, mask=eq_6)
code_block_10 = CodeBlock { 0.5; }
pointAtParameter_3 = Curve.PointAtParameter(curve=filterByBoolMask_8.in, param=code_block_10)
Z_3 = Point.Z(point=pointAtParameter_3)
maximumItem_4 = List.MaximumItem(list=Z_3)
eq_7 = Z_3 == maximumItem_4
filterByBoolMask_9 = List.FilterByBoolMask(list=filterByBoolMask_8.in, mask=eq_7)
flatten_5 = List.Flatten(list=filterByBoolMask_9.in)
name_3 = Family.Name(family=filterByBoolMask.in)
code_block_11 = CodeBlock { "Sidewalk"; }
contains_3 = String.Contains(string=name_3, searchFor=code_block_11)
filterByBoolMask_10 = List.FilterByBoolMask(list=filterByBoolMask.in, mask=contains_3)
element_geometry_fixer_3 = Custom[Element.Geometry Fixer](VARElement=filterByBoolMask_10.in)
flatten_6 = List.Flatten(list=element_geometry_fixer_3)
doesIntersect = Geometry.DoesIntersect(geometry=flatten_6, other=flatten_3@L1)
transpose = List.Transpose(lists=doesIntersect)
anyTrue = Custom[CW.List.AnyTrue](VARseq=transpose)  # package Synthesize toolkit; Returns true if any item in a list of booleans is true.
filterByBoolMask_11 = List.FilterByBoolMask(list=filterByBoolMask_10.in, mask=anyTrue)
code_block_12 = CodeBlock { "Comments"; }
getParameterValueByName = Element.GetParameterValueByName(element=filterByBoolMask_11.out, parameterName=code_block_12)
code_block_13 = CodeBlock { "-"; }
split = String.Split(string=getParameterValueByName, separator0=code_block_13)
toNumber = String.ToNumber(string=split)
code_block_14 = CodeBlock { 3; }
round_3 = Math.Round(number=toNumber, digits=code_block_14)
uniqueItems = List.UniqueItems(list=round_3@L2)
filterByBoolMask_12 = List.FilterByBoolMask(list=flatten_6, mask=anyTrue)
explode_4 = Geometry.Explode(geometry=filterByBoolMask_12.out)
area_2 = Surface.Area(surface=explode_4)
round_4 = Math.Round(number=area_2, digits=code_block_14)
python_script_3 = Python(IN[0]=uniqueItems, IN[1]=round_4, IN[2]=explode_4)  # IronPython2
# ---------- python_script_3.python (64 lines) ----------
# Created By Karam Baki : karam@aecedx.com
# Enable Python support and load DesignScript library
# IMPORTANT : ALL DYNAMO DESIGN SCRIPT NODES ARE AS (dg)
import clr
clr.AddReference('ProtoGeometry')
from Autodesk.DesignScript import Geometry as dg

# EXTENSION Enable ToDSType
clr.AddReference('RevitNodes')
import Revit
clr.ImportExtensions(Revit.Elements)

# Enable Revit Elements
from Revit.Elements import *

# EXTENSION Enable Geometry Conversion Methods
clr.ImportExtensions(Revit.GeometryConversion)

# Enable Revit API
clr.AddReference('RevitAPI')
from Autodesk.Revit.DB import *

# Enable DocumentManager and TransactionManager
clr.AddReference('RevitServices')
from RevitServices.Persistence import DocumentManager
from RevitServices.Transactions import TransactionManager

# Enable ICollection List Translate
clr.AddReference("System")
import System.Collections.Generic
from System.Collections.Generic import List

dataEnteringNode = IN
# Use UnwrapElement(IN[0]) When Translating From Dynamo to Revit
filterlists=UnwrapElement(IN[0])
targetnumbers=UnwrapElement(IN[1])
surfaceslists=UnwrapElement(IN[2])

# Choose The Current Document
doc = DocumentManager.Instance.CurrentDBDocument
uidoc = DocumentManager.Instance.CurrentUIApplication.ActiveUIDocument
uiapp = DocumentManager.Instance.CurrentUIApplication
app = uiapp.Application

# Create Empty List
result = []

globalcount = 0
for eachlist in filterlists:
	tmp = []
	for each in eachlist:
		tmp2 = []
		count = 0
		for e in targetnumbers[globalcount]:
			if each == e:
				tmp2.append(surfaceslists[globalcount][count])
				count = count + 1
			else:
				count = count + 1
		tmp.append(tmp2)
	result.append(tmp)
	globalcount = globalcount + 1
# Assign your output to the OUT variable.
OUT = result
# ----------------------------------------
code_block_15 = CodeBlock { 2; }
chop = List.Chop(list=python_script_3@L2, lengths=code_block_15)
code_block_16 = CodeBlock { 0.5; }
pointAtParameter_4 = Surface.PointAtParameter(surface=chop, u=code_block_16, v=code_block_16)
Z_4 = Point.Z(point=pointAtParameter_4)
minimumItem_3 = List.MinimumItem(list=Z_4)
eq_8 = Z_4 == minimumItem_3
filterByBoolMask_13 = List.FilterByBoolMask(list=chop, mask=eq_8)
flatten_7 = List.Flatten(list=filterByBoolMask_13.in)
perimeterCurves_4 = Surface.PerimeterCurves(surface=flatten_7)
flatten_8 = List.Flatten(list=perimeterCurves_4)
create = List.Create(item0=flatten_2, item1=flatten_4, item2=flatten_5, item3=flatten_8)
code_block_17 = CodeBlock { false; }
clean = List.Clean(list=create, preserveIndices=code_block_17)
flatten_9 = List.Flatten(list=clean)
length_3 = Curve.Length(curve=flatten_9)
div = length_3 / n03_spacing_between_points_to_add
round_5 = Math.Round(number=div)
range = Range(end=round_5, lacing=Longest)
code_block_18 = CodeBlock { 0; 1; }
remapRange = Math.RemapRange(numbers=range, newMin=code_block_18.out0, newMax=code_block_18.out1)
pointAtParameter_5 = Curve.PointAtParameter(curve=flatten_9, param=remapRange)
flatten_10 = List.Flatten(list=pointAtParameter_5)
code_block_19 = CodeBlock { false; }
pruneDuplicates = Custom[SP.Points.PruneDuplicates+](VARpoints=flatten_10, VARkeepDuplicateZ=code_block_19)  # package Synthesize toolkit; An alternative to the built in node, that performs faster at the price of loosing the order of the points. All floating point valies are rounded to the nearest 4 decimal points. You can optionally remove duplicate Z values by setting "keepDuplicateZ" to false.
select_topography_from_subregion = Custom[Select Topography From Subregion](VARTopography=n01_select_topography)  # package Synthesize toolkit; Select Topography From Subregion
X = Point.X(point=pruneDuplicates)
add = X + n04_nearby_points_cleaning_range
Y = Point.Y(point=pruneDuplicates)
add_2 = Y + n04_nearby_points_cleaning_range
boundingBox = Element.BoundingBox(element=select_topography_from_subregion)
maxPoint = BoundingBox.MaxPoint(boundingBox=boundingBox)
Z_5 = Point.Z(point=maxPoint)
byCoordinates = Point.ByCoordinates(x=add, y=add_2, z=Z_5)
sub = X - n04_nearby_points_cleaning_range
sub_2 = Y - n04_nearby_points_cleaning_range
minPoint = BoundingBox.MinPoint(boundingBox=boundingBox)
Z_6 = Point.Z(point=minPoint)
byCoordinates_2 = Point.ByCoordinates(x=sub, y=sub_2, z=Z_6)
python_script_4 = Python(IN[0]=pruneDuplicates, IN[1]=select_topography_from_subregion, IN[2]=byCoordinates, IN[3]=byCoordinates_2, IN[4]=n04_nearby_points_cleaning_range, IN[5]=pruneDuplicates)  # IronPython2
# ---------- python_script_4.python (120 lines) ----------
# Created By Karam Baki : karam@aecedx.com
# Enable Python support and load DesignScript library
# IMPORTANT : ALL DYNAMO DESIGN SCRIPT NODES ARE AS (dg)
import clr
clr.AddReference('ProtoGeometry')
from Autodesk.DesignScript import Geometry as dg

# EXTENSION Enable ToDSType
clr.AddReference('RevitNodes')
import Revit
clr.ImportExtensions(Revit.Elements)

# Enable Revit Elements
from Revit.Elements import *

# EXTENSION Enable Geometry Conversion Methods
clr.ImportExtensions(Revit.GeometryConversion)

# Enable Revit API
clr.AddReference('RevitAPI')
from Autodesk.Revit.DB import *
import Autodesk.Revit.DB
# Enable DocumentManager and TransactionManager
clr.AddReference('RevitServices')
from RevitServices.Persistence import DocumentManager
from RevitServices.Transactions import TransactionManager

# Enable ICollection List Translate
clr.AddReference("System")
import System.Collections.Generic
from System.Collections.Generic import List
doc = DocumentManager.Instance.CurrentDBDocument
uidoc = DocumentManager.Instance.CurrentUIApplication.ActiveUIDocument
uiapp = DocumentManager.Instance.CurrentUIApplication
app = uiapp.Application

class WarnSwallow(IFailuresPreprocessor):
	def PreprocessFailures(self, failuresAccessor):
		failuresAccessor.DeleteAllWarnings()
		return FailureProcessingResult.Continue

dataEnteringNode = IN
# Use UnwrapElement(IN[0]) When Translating From Dynamo to Revit
points = UnwrapElement(IN[0])
topo = UnwrapElement(IN[1])
minp = UnwrapElement(IN[2])
maxp = UnwrapElement(IN[3])
range = IN[4]
goodpts = UnwrapElement(IN[5])

if range > 0:

	count = 0
	bboxes = []
	for each in minp:
		bboxes.append(dg.BoundingBox.ByCorners(each, maxp[count]))
		count = count + 1

	allpts = topo.GetPoints()
	convpts = []
	for each in allpts:
		convpts.append(each.ToPoint())

	todelpts = []
	for eachbox in bboxes:
		for e in convpts:
			if dg.BoundingBox.Contains(eachbox,e):
				todelpts.append(e)
	uniquetodelpts = set(todelpts)
	todelpts = list(uniquetodelpts)

	todelxyz = []
	for e in todelpts:
		todelxyz.append(e.ToXyz())

	#Disposing Stuff
	for e in convpts:
		e.Dispose()

Revit.Transaction.Transaction.End(doc)

xyzconvgood = []
for each in goodpts:
	try:
		xyzconvgood.append(each.ToXyz())
	except:
		pass

failproc = WarnSwallow()
ilistofidsgood = List[Autodesk.Revit.DB.XYZ](xyzconvgood)
if range > 0:
	ilistofids = List[Autodesk.Revit.DB.XYZ](todelxyz)
editsession = Architecture.TopographyEditScope(doc,"Topo Stitch")
editsessioncl = Architecture.TopographyEditScope(doc,"Topo Clean Up")

if range > 0:
	try:
		Revit.Transaction.Transaction.End(doc)
		editsessioncl.Start(topo.Id)
		TransactionManager.Instance.EnsureInTransaction(doc)
		topo.DeletePoints(ilistofids)
		TransactionManager.Instance.ForceCloseTransaction()
		editsessioncl.Commit(failproc)
	except:
		pass
	Revit.Transaction.Transaction.End(doc)
	editsession.Start(topo.Id)
	TransactionManager.Instance.EnsureInTransaction(doc)
	topo.AddPoints(ilistofidsgood)
	TransactionManager.Instance.ForceCloseTransaction()
	editsession.Commit(failproc)
else:
	Revit.Transaction.Transaction.End(doc)
	editsession.Start(topo.Id)
	TransactionManager.Instance.EnsureInTransaction(doc)
	topo.AddPoints(ilistofidsgood)
	TransactionManager.Instance.ForceCloseTransaction()
	editsession.Commit(failproc)

OUT = topo
# ----------------------------------------
debug_python = Custom[Debug Python]()  # package Synthesize toolkit; Debug Python
