# Dynamo graph Topography.Subregions Offset and Separate.dyn (Dynamo 2.13.1.3887)
# author: karam@aecedx.com
# packages: Synthesize toolkit 12.5.1

# group: Input
n01_select_subregions = DSModelElementsSelection()  # "01.Select Subregions"; nothing selected; graph input
offset = DoubleInput(0)  # "02.Offset"; graph input
n03_segmentation_spline = DoubleInput(0)  # "03.Segmentation: Spline Segmentation Distance (0 to Leave as Spline)"; graph input
n05_segmentation_produce_lines = BoolSelector(false)  # "05.Segmentation: Produce Lines Only ?"; graph input
n04_segmentation_consider_arcs = BoolSelector(false)  # "04.Segmentation: Consider Arcs too ?"; graph input

code_block = CodeBlock { "Topography"; }
byClassName = Custom[SP.Filter.ByClassName](VARobject=n01_select_subregions, VARclassName=code_block)  # package Synthesize toolkit; Filters a list of objects by the object's class name. Note that Dynamo elements belong to different classes than their Revit counterparts. Use the Object.Class node to check an object's class.
is_topography_subregion = Custom[Is Topography Subregion](VARTopography=byClassName.VARin@L1)  # package Synthesize toolkit; Is Topography Subregion
filterByBoolMask = List.FilterByBoolMask(list=byClassName.VARin, mask=is_topography_subregion)
python_script = Python(IN[0]=filterByBoolMask.in)  # IronPython2
# ---------- python_script.python (71 lines) ----------
# Enable Python support and load DesignScript library
# IMPORTANT : ALL DYNAMO DESIGN SCRIPT NODES ARE AS (dg)
import clr
clr.AddReference('ProtoGeometry')
from Autodesk.DesignScript import Geometry as dg

# EXTENSION Enable ToDSType
clr.AddReference('RevitNodes')
import Revit
clr.ImportExtensions(Revit.Elements)

# Enable Revit Elements
from Revit.Elements import *

# EXTENSION Enable Geometry Conversion Methods
clr.ImportExtensions(Revit.GeometryConversion)

# Enable Revit API
clr.AddReference('RevitAPI')
from Autodesk.Revit.DB import *

# Enable DocumentManager and TransactionManager
clr.AddReference('RevitServices')
from RevitServices.Persistence import DocumentManager
from RevitServices.Transactions import TransactionManager

# Enable ICollection List Translate
clr.AddReference("System")
import System.Collections.Generic
from System.Collections.Generic import List

def tolist(obj1):
	if hasattr(obj1,'__iter__'): return obj1
	else: return [obj1]

dataEnteringNode = IN
# Use UnwrapElement(IN[0]) When Translating From Dynamo to Revit
subs = UnwrapElement(tolist(IN[0]))
# Choose The Current Document
doc = DocumentManager.Instance.CurrentDBDocument
uidoc = DocumentManager.Instance.CurrentUIApplication.ActiveUIDocument
uiapp = DocumentManager.Instance.CurrentUIApplication
app = uiapp.Application

def convert(sub):
	if sub.IsSiteSubRegion:
		subregion = sub.AsSiteSubRegion()
		boundary = subregion.GetBoundary()
		converted = []
		for blist in boundary:
			tmp = []
			for l in blist:
				tmp.append(l.ToProtoType(False))
			converted.append(tmp)
		mat = sub.get_Parameter(BuiltInParameter.MATERIAL_ID_PARAM).AsElementId()
		doc.Delete(sub.Id)
	return converted,mat

TransactionManager.Instance.EnsureInTransaction(doc)
result = []
mats = []
for sub in subs:
	try:
		op = convert(sub)
		result.append(op[0])
		mats.append(op[1])
	except:
		pass
TransactionManager.Instance.TransactionTaskDone()
# Assign your output to the OUT variable.
OUT = result,mats
# ----------------------------------------
code_block_2 = CodeBlock(a=python_script) { a[0]; a[1]; }
curves_offset_to_revit = Custom[Curves Offset To Revit Compatibility](VARCurves=code_block_2.out0@L3, VAROffset=offset)  # package Synthesize toolkit; Curves Offset To Revit Compatibility
python_script_2 = Python(IN[0]=curves_offset_to_revit.VARCurves, IN[1]=n03_segmentation_spline, IN[2]=n05_segmentation_produce_lines, IN[3]=n04_segmentation_consider_arcs)  # IronPython2
# ---------- python_script_2.python (93 lines) ----------
# Created By Karam Baki : karam@aecedx.com
# Enable Python support and load DesignScript library
# IMPORTANT : ALL DYNAMO DESIGN SCRIPT NODES ARE AS (dg)
import clr
clr.AddReference('ProtoGeometry')
from Autodesk.DesignScript import Geometry as dg

# EXTENSION Enable ToDSType
clr.AddReference('RevitNodes')
import Revit
clr.ImportExtensions(Revit.Elements)

def normalize(length,nostartend = False,twominonly = False):
	if length != None:
		if length <= 3 and twominonly == False:
			length = 4
		elif length <= 3 and twominonly == True:
			if length < 2:
				length = 2
		if nostartend:
			length += 2
		a = range(0,int(length))
		points = []
		amin, amax = min(a), max(a)
		item = []
		for val in a:
			item.append(float(val-amin) / float(amax-amin))
	else:
		item = [None]
	if nostartend == True:
		item.pop(0)
		item.pop(-1)
	return item

def fixcurve(crv,div):
	nums = normalize(div)
	pts = []
	for n in nums:
		pts.append(dg.Curve.PointAtParameter(crv,n))
	curve = dg.NurbsCurve.ByControlPoints(pts)
	return curve

def spltocurve(crv,distance,aslines,arcstoo):
	try:
		if ("NurbsCurve" in crv.ToString() or (arcstoo and "Arc" in crv.ToString())) and distance != 0:
			div = int(round(crv.Length/distance))
			if div < 3:
				div = 2
			arcs = []
			increment = 1.0 / div
			try:
				tan = crv.TangentAtParameter(0)
			except:
				crv = fixcurve(crv,div*10)
				tan = crv.TangentAtParameter(0)
			for j in range(0, div):
				incstart = increment * j
				incend = increment * (j+1)
				ptstart = crv.PointAtParameter(incstart)
				ptend = crv.PointAtParameter(incend)
				if aslines:
					arc = dg.Line.ByStartPointEndPoint(ptstart,ptend)
				else:
					try:
						arc = dg.Arc.ByStartPointEndPointStartTangent(ptstart,ptend,tan)
					except:
						arc = dg.Line.ByStartPointEndPoint(ptstart,ptend)
				arcs.append(arc)
				tan = arc.TangentAtParameter(1)
			joined = dg.PolyCurve.ByJoinedCurves(arcs)
			return joined
		else:
			return crv
	except:
		return crv

lists = UnwrapElement(IN[0])
distance = IN[1]
aslines = IN[2]
arcstoo = IN[3]

result = []
for l in lists:
	tmp = []
	for c in l:
		tmp2 = []
		for i in c:
			tmp2.append(spltocurve(i,distance,aslines,arcstoo))
		tmp.append(tmp2)
	result.append(tmp)

# Assign your output to the OUT variable.
OUT = result
# ----------------------------------------
as_polycurve_bycurves = Custom[AS.[&] PolyCurve.ByCurves](VARcurves=python_script_2)  # package Synthesize toolkit; Create polycurves from an unordered list of curves.
flatten = List.Flatten(list=as_polycurve_bycurves.VARpolyCurve@L3)
byPatch = Surface.ByPatch(closedCurve=flatten)
code_block_3 = CodeBlock { false; }
join_adjacent_surfaces_legacy = Custom[Join Adjacent Surfaces Legacy](VARSurfaces=byPatch@L2, VARNormalsCheck=code_block_3)  # package Synthesize toolkit; Join Adjacent Surfaces
unconnectedBoundaries = PolySurface.UnconnectedBoundaries(polySurface=join_adjacent_surfaces_legacy)
curves = PolyCurve.Curves(polyCurve=unconnectedBoundaries)
select_topography_from_subregion = Custom[Select Topography From Subregion](VARTopography=filterByBoolMask.in@L1)  # package Synthesize toolkit; Select Topography From Subregion
uniqueItems = List.UniqueItems(list=select_topography_from_subregion)
firstItem = List.FirstItem(list=uniqueItems)
python_script_3 = Python(IN[0]=code_block_2.out1, IN[1]=join_adjacent_surfaces_legacy)  # IronPython2
# ---------- python_script_3.python (21 lines) ----------
import clr
clr.AddReference('ProtoGeometry')
from Autodesk.DesignScript.Geometry import *
#The inputs to this node will be stored as a list in the IN variables.
dataEnteringNode = IN

list1 = UnwrapElement(IN[0])
list2 = UnwrapElement(IN[1])

matched = []
count = 0
for l in list2:
	cur = list1[count]
	count += 1
	number = range(0,len(l))
	tmp = []
	for n in number:
		tmp.append(cur)
	matched.append(tmp)
#Assign your output to the OUT variable.
OUT = matched
# ----------------------------------------
flatten_2 = List.Flatten(list=python_script_3)
python_script_4 = Python(IN[0]=curves, IN[1]=firstItem, IN[2]=flatten_2)  # IronPython2
# ---------- python_script_4.python (87 lines) ----------
# Enable Python support and load DesignScript library
# IMPORTANT : ALL DYNAMO DESIGN SCRIPT NODES ARE AS (dg)
import clr
clr.AddReference('ProtoGeometry')
from Autodesk.DesignScript import Geometry as dg

# EXTENSION Enable ToDSType
clr.AddReference('RevitNodes')
import Revit
clr.ImportExtensions(Revit.Elements)

# Enable Revit Elements
from Revit.Elements import *

# EXTENSION Enable Geometry Conversion Methods
clr.ImportExtensions(Revit.GeometryConversion)

# Enable Revit API
clr.AddReference('RevitAPI')
from Autodesk.Revit.DB import *
from Autodesk.Revit.DB.Architecture import *
# Enable DocumentManager and TransactionManager
clr.AddReference('RevitServices')
from RevitServices.Persistence import DocumentManager
from RevitServices.Transactions import TransactionManager

# Enable ICollection List Translate
clr.AddReference("System")
import System.Collections.Generic
from System.Collections.Generic import List
import math
from itertools import compress

def tolist(obj1):
	if hasattr(obj1,'__iter__'): return obj1
	else: return [obj1]

dataEnteringNode = IN
# Use UnwrapElement(IN[0]) When Translating From Dynamo to Revit
bigboundaries = UnwrapElement(IN[0])
host = UnwrapElement(IN[1])
matids = UnwrapElement(IN[2])

# Choose The Current Document
doc = DocumentManager.Instance.CurrentDBDocument
uidoc = DocumentManager.Instance.CurrentUIApplication.ActiveUIDocument
uiapp = DocumentManager.Instance.CurrentUIApplication
app = uiapp.Application

def convertback(boundary):
	converted = []
	for blist in boundary:
		tmp = CurveLoop()
		for b in blist:
			tmp.Append(b.ToRevitType(False))
		converted.append(tmp)
	return converted

TransactionManager.Instance.EnsureInTransaction(doc)
count = 0
createdSubRegions = []
for boundaries in bigboundaries:
	currentmat = matids[count]
	count += 1
	tmpsub = []
	for boundary in boundaries:
		try:
			bigcurve = List[CurveLoop]()
			converted = convertback(boundary)
			for conv in converted:
				bigcurve.Add(conv)
		except:
			continue
		try:
			if SiteSubRegion.IsValidBoundary(bigcurve):
				newSubRegion = SiteSubRegion.Create(doc, bigcurve, host.Id).TopographySurface
				parm = newSubRegion.get_Parameter(BuiltInParameter.MATERIAL_ID_PARAM)
				if str(currentmat) == "-1":
					parm.Set(ElementId(-1))
				else:
					parm.Set(currentmat)
				createdSubRegions.append(newSubRegion)
		except:
			pass
TransactionManager.Instance.TransactionTaskDone()
# Assign your output to the OUT variable.
OUT = createdSubRegions
# ----------------------------------------
debug_python_no_message = Custom[Debug Python No Message]()  # package Synthesize toolkit; Debug Python
