# Dynamo graph Topography.Subregions Split By Level.dyn (Dynamo 2.13.1.3887)
# author: karam@aecedx.com
# packages: Synthesize toolkit 12.5.1

# group: Input
n01_select_subregions = DSModelElementsSelection()  # "01.Select Subregions"; nothing selected; graph input
n02_split_level = Levels()  # "02.Split Level"; nothing selected; graph input

code_block = CodeBlock { "Topography"; }
byClassName = Custom[SP.Filter.ByClassName](VARobject=n01_select_subregions, VARclassName=code_block)  # package Synthesize toolkit; Filters a list of objects by the object's class name. Note that Dynamo elements belong to different classes than their Revit counterparts. Use the Object.Class node to check an object's class.
is_topography_subregion = Custom[Is Topography Subregion](VARTopography=byClassName.VARin@L1)  # package Synthesize toolkit; Is Topography Subregion
filterByBoolMask = List.FilterByBoolMask(list=byClassName.VARin, mask=is_topography_subregion)
polySurface = Custom[ZK.Topography.PolySurface](VARTopography=filterByBoolMask.in@L1)  # package Synthesize toolkit; Convert topography element to polysurface
plane = Custom[CW.Level.Plane](VARlevel=n02_split_level)  # package Synthesize toolkit; Retrieves the plane of a given level
split = Geometry.Split(geometry=polySurface.VARPolySurface, other=plane)
perimeterCurves = Surface.PerimeterCurves(surface=split)
startPoint = Curve.StartPoint(curve=perimeterCurves)
byPoints = Polygon.ByPoints(points=startPoint)
center = Polygon.Center(polygon=byPoints)
Z = Point.Z(point=center)
origin = Point.Origin()
closestPointTo = Geometry.ClosestPointTo(geometry=plane, other=origin)
Z_2 = Point.Z(point=closestPointTo)
lt = Z < Z_2
filterByBoolMask_2 = List.FilterByBoolMask(list=split, mask=lt)
isEmpty = List.IsEmpty(list=filterByBoolMask_2.in, lacing=Longest)
isEmpty_2 = List.IsEmpty(list=filterByBoolMask_2.out, lacing=Longest)
create = List.Create(item0=isEmpty, item1=isEmpty_2)
transpose = List.Transpose(lists=create)
anyTrue = Custom[CW.List.AnyTrue](VARseq=transpose)  # package Synthesize toolkit; Returns true if any item in a list of booleans is true.
filterByBoolMask_3 = List.FilterByBoolMask(list=filterByBoolMask_2.in, mask=anyTrue)
byJoinedSurfaces = PolySurface.ByJoinedSurfaces(surfaces=filterByBoolMask_3.out)
perimeterCurves_2 = Surface.PerimeterCurves(surface=byJoinedSurfaces)
pullOntoPlane = Curve.PullOntoPlane(curve=perimeterCurves_2, plane=plane)
as_polycurve_bycurves = Custom[AS.[&] PolyCurve.ByCurves](VARcurves=pullOntoPlane)  # package Synthesize toolkit; Create polycurves from an unordered list of curves.
curves = PolyCurve.Curves(polyCurve=as_polycurve_bycurves.VARpolyCurve)
curves_offset_to_revit = Custom[Curves Offset To Revit Compatibility](VARCurves=curves@L3)  # package Synthesize toolkit; Curves Offset To Revit Compatibility
filterByBoolMask_4 = List.FilterByBoolMask(list=filterByBoolMask_2.out, mask=anyTrue)
byJoinedSurfaces_2 = PolySurface.ByJoinedSurfaces(surfaces=filterByBoolMask_4.out)
perimeterCurves_3 = Surface.PerimeterCurves(surface=byJoinedSurfaces_2)
pullOntoPlane_2 = Curve.PullOntoPlane(curve=perimeterCurves_3, plane=plane)
as_polycurve_bycurves_2 = Custom[AS.[&] PolyCurve.ByCurves](VARcurves=pullOntoPlane_2)
curves_2 = PolyCurve.Curves(polyCurve=as_polycurve_bycurves_2.VARpolyCurve)
curves_offset_to_revit_2 = Custom[Curves Offset To Revit Compatibility](VARCurves=curves_2@L3)
join = List.Join(list0=curves_offset_to_revit.VARCurves, list1=curves_offset_to_revit_2.VARCurves)
firstItem = List.FirstItem(list=polySurface.VARHostTopography)
filterByBoolMask_5 = List.FilterByBoolMask(list=filterByBoolMask.in, mask=anyTrue)
code_block_2 = CodeBlock { "Material"; }
getParameterValueByName = Element.GetParameterValueByName(element=filterByBoolMask_5.out, parameterName=code_block_2)
join_2 = List.Join(list0=getParameterValueByName, list1=getParameterValueByName)
python_script = Python(IN[0]=join, IN[1]=firstItem, IN[2]=join_2, IN[3]=filterByBoolMask_5.out)  # IronPython2
# ---------- python_script.python (94 lines) ----------
# Enable Python support and load DesignScript library
# IMPORTANT : ALL DYNAMO DESIGN SCRIPT NODES ARE AS (dg)
import clr
clr.AddReference('ProtoGeometry')
from Autodesk.DesignScript import Geometry as dg

# EXTENSION Enable ToDSType
clr.AddReference('RevitNodes')
import Revit
clr.ImportExtensions(Revit.Elements)

# Enable Revit Elements
from Revit.Elements import *

# EXTENSION Enable Geometry Conversion Methods
clr.ImportExtensions(Revit.GeometryConversion)

# Enable Revit API
clr.AddReference('RevitAPI')
from Autodesk.Revit.DB import *
from Autodesk.Revit.DB.Architecture import *
# Enable DocumentManager and TransactionManager
clr.AddReference('RevitServices')
from RevitServices.Persistence import DocumentManager
from RevitServices.Transactions import TransactionManager

# Enable ICollection List Translate
clr.AddReference("System")
import System.Collections.Generic
from System.Collections.Generic import List
import math
from itertools import compress

def tolist(obj1):
	if hasattr(obj1,'__iter__'): return obj1
	else: return [obj1]

dataEnteringNode = IN
# Use UnwrapElement(IN[0]) When Translating From Dynamo to Revit
bigboundaries = UnwrapElement(IN[0])
host = UnwrapElement(IN[1])
mats = UnwrapElement(IN[2])
todel = UnwrapElement(IN[3])

matids = []
for mat in mats:
	try:
		matids.append(mat.Id)
	except:
		matids.append(-1)

# Choose The Current Document
doc = DocumentManager.Instance.CurrentDBDocument
uidoc = DocumentManager.Instance.CurrentUIApplication.ActiveUIDocument
uiapp = DocumentManager.Instance.CurrentUIApplication
app = uiapp.Application

def convertback(boundary):
	converted = []
	for blist in boundary:
		converted.append(blist.ToRevitType())
	return converted

TransactionManager.Instance.EnsureInTransaction(doc)
for tod in todel:
	doc.Delete(tod.Id)
doc.Regenerate()
count = 0
createdSubRegions = []
for boundaries in bigboundaries:
	currentmat = matids[count]
	count += 1
	tmpsub = []
	bigcurve = List[CurveLoop]()
	for boundary in boundaries:
		converted = convertback(boundary)
		x = CurveLoop()
		for l in converted:
			x.Append(l)
		bigcurve.Add(x)
	if 1 == 1:
		if SiteSubRegion.IsValidBoundary(bigcurve):
			newSubRegion = SiteSubRegion.Create(doc, bigcurve, host.Id).TopographySurface
			parm = newSubRegion.get_Parameter(BuiltInParameter.MATERIAL_ID_PARAM)
			if currentmat == -1:
				parm.Set(ElementId(-1))
			else:
				parm.Set(currentmat)
			createdSubRegions.append(newSubRegion)
	#except:
	#	pass
TransactionManager.Instance.TransactionTaskDone()
# Assign your output to the OUT variable.
OUT = createdSubRegions
# ----------------------------------------
allTrue = List.AllTrue(list=anyTrue)
code_block_3 = CodeBlock { "Nothing to Split\nPlease Choose Correct Intersecting Level"; }
code_block_4 = CodeBlock { null; }
scopeIf = Custom[CW.ScopeIf+](VARtest=allTrue, VARtrue=code_block_3, VARfalse=code_block_4)  # package Synthesize toolkit; A (hopefully) more robust implementation of ScopeIf. Tests a single boolean and returns a value accordingly.
alert_popup = Custom[Alert Popup](VARMessage=scopeIf)  # package Synthesize toolkit; Popup a message dialog in Revit
