# Dynamo graph Topography.Surfaces From Civil 3D.dyn (Dynamo 2.13.1.3887)
# author: karam@aecedx.com
# packages: Synthesize toolkit 12.5.1

# group: Input
n03_create_selection_filters = BoolSelector(true)  # "03.Create Selection Filters ?"; graph input
n04_filter_name = StringInput("Dynamo Surfaces")  # "04.Filter Name"; graph input
n01_select_cad_link_import = DSModelElementSelection()  # "01.Select CAD Link/Import"; nothing selected; graph input
n02_street_width = DoubleInput(8)  # "02.Street Width"; graph input

code_block = CodeBlock { false; }
turnIntoList = Custom[CW.TurnIntoList](VARunknownItem=n01_select_cad_link_import)  # package Synthesize toolkit; Turns an element (or a nested list) into a flat list
street_lines_prepare = Custom[Street Lines Prepare](VARCADImport=turnIntoList, VARStreetWidth=n02_street_width)  # package Synthesize toolkit; Street Lines Prepare
code_block_2 = CodeBlock(a=street_lines_prepare.VARCurvesAndSurfaces) { a[2]; }
code_block_3 = CodeBlock { true; }
dynamo_geometry_to_revit = Custom[Dynamo Geometry To Revit Compatibility](VARGeometryOrSat=code_block_2, VARPreferImportInstance=code_block_3)  # package Synthesize toolkit; Dynamo Geometry To Revit Compatibility
generate_selection_filter = Custom[Generate Selection Filter](VARCreateSelectionFilter=n03_create_selection_filters, VARFilterNametoCreate=n04_filter_name, VAROverwriteExistingFilter=code_block, VARElements=dynamo_geometry_to_revit)  # package Synthesize toolkit; Generate Selection FIlter
debug_python = Custom[Debug Python]()  # package Synthesize toolkit; Debug Python
