# Dynamo graph Topography.Surfaces Offset.dyn (Dynamo 2.13.1.3887)
# author: karam@aecedx.com
# packages: Synthesize toolkit 12.5.1

# group: Input
n04_create_selection_filters = BoolSelector(true)  # "04.Create Selection Filters ?"; graph input
n05_filter_name = StringInput("Dynamo Surfaces Offset")  # "05.Filter Name"; graph input
n01_select_surfaces = DSModelElementsSelection()  # "01.Select Surfaces"; nothing selected; graph input
n02_surfaces_offset_for_saefty = DoubleInput(-0.01)  # "02.Surfaces Offset (For Saefty)"; graph input
n03_delete_old = BoolSelector(true)  # "03.Delete Old ?"; graph input

code_block = CodeBlock { false; }
code_block_2 = CodeBlock { "ImportInstance"; }
filterByString = Custom[ST.List.FilterByString](VARlist=n01_select_surfaces, VARString=code_block_2)  # package Synthesize toolkit; Filter a list by a string match
turnIntoList = Custom[CW.TurnIntoList](VARunknownItem=filterByString.VARMatch)  # package Synthesize toolkit; Turns an element (or a nested list) into a flat list
flatten = List.Flatten(list=turnIntoList)
geometry = Element.Geometry(element=flatten)
flatten_2 = List.Flatten(list=geometry)
code_block_3 = CodeBlock { "Autodesk.DesignScript.Geometry.Surface"; }
removeIfNot = List.RemoveIfNot(list=flatten_2, type=code_block_3)
perimeterCurves = Surface.PerimeterCurves(surface=removeIfNot)
curves_offset_to_revit = Custom[Curves Offset To Revit Compatibility](VARCurves=perimeterCurves, VAROffset=n02_surfaces_offset_for_saefty)  # package Synthesize toolkit; Curves Offset To Revit Compatibility
byJoinedCurves = PolyCurve.ByJoinedCurves(curves=curves_offset_to_revit.VARCurves)
byPatch = Surface.ByPatch(closedCurve=byJoinedCurves)
flatten_3 = List.Flatten(list=byPatch)
code_block_4 = CodeBlock { true; }
dynamo_geometry_to_revit = Custom[Dynamo Geometry To Revit Compatibility](VARGeometryOrSat=flatten_3, VARPreferImportInstance=code_block_4)  # package Synthesize toolkit; Dynamo Geometry To Revit Compatibility
generate_selection_filter = Custom[Generate Selection Filter](VARCreateSelectionFilter=n04_create_selection_filters, VARFilterNametoCreate=n05_filter_name, VAROverwriteExistingFilter=code_block, VARElements=dynamo_geometry_to_revit)  # package Synthesize toolkit; Generate Selection FIlter
passthrough = Custom[CW.Passthrough](VARpassThrough=flatten, VARwaitFor=geometry)  # package Synthesize toolkit; Forces a sequential order of execution. The node wired into the output of the Passthrough node will be executed *after* the node wired into the waitFor input (e.g. important for some Revit operations). The value of the passThrough input will be passed on to the node wired into the output port of the Passthrough node.
empty = List.Empty()
scopeIf = Custom[CW.ScopeIf+](VARtest=n03_delete_old, VARtrue=passthrough, VARfalse=empty)  # package Synthesize toolkit; A (hopefully) more robust implementation of ScopeIf. Tests a single boolean and returns a value accordingly.
eraser = Custom[ST.Tool.Eraser](VARList=scopeIf)  # package Synthesize toolkit; Try to delete any element from project
debug_python = Custom[Debug Python]()  # package Synthesize toolkit; Debug Python
