# Dynamo graph Topography.Surfaces Split By Model Line.dyn (Dynamo 2.13.1.3887)
# author: karam@aecedx.com
# packages: Synthesize toolkit 12.5.1

# group: Input
n04_delete_old = BoolSelector(true)  # "04.Delete Old ?"; graph input
n01_select_surfaces_and_splitting = DSModelElementsSelection()  # "01.Select Surfaces And Splitting Model Lines"; nothing selected; graph input
n03_segmentation_distance_for = DoubleInput(5)  # "03.Segmentation Distance For Curved Lines"; graph input
offset = DoubleInput(0)  # "02.Offset"; graph input

code_block = CodeBlock { "ImportInstance"; }
filterByString = Custom[ST.List.FilterByString](VARlist=n01_select_surfaces_and_splitting, VARString=code_block)  # package Synthesize toolkit; Filter a list by a string match
code_block_2 = CodeBlock { "ModelCurve"; }
filterByString_2 = Custom[ST.List.FilterByString](VARlist=n01_select_surfaces_and_splitting, VARString=code_block_2)
element_geometry_fixer = Custom[Element.Geometry Fixer](VARElement=filterByString.VARMatch)  # package Synthesize toolkit; Element.Geometry Fixer
surfaces_prepare_for_subregions = Custom[Surfaces Prepare For Subregions](VARSegmentationDistance=n03_segmentation_distance_for, VARElement=filterByString_2.VARMatch, VARSurfaces=element_geometry_fixer, VAROffset=offset)  # package Synthesize toolkit; Surfaces Prepare For Subregions
passthrough = Custom[CW.Passthrough](VARpassThrough=filterByString.VARMatch, VARwaitFor=surfaces_prepare_for_subregions)  # package Synthesize toolkit; Forces a sequential order of execution. The node wired into the output of the Passthrough node will be executed *after* the node wired into the waitFor input (e.g. important for some Revit operations). The value of the passThrough input will be passed on to the node wired into the output port of the Passthrough node.
empty = List.Empty()
scopeIf = Custom[CW.ScopeIf+](VARtest=n04_delete_old, VARtrue=passthrough, VARfalse=empty)  # package Synthesize toolkit; A (hopefully) more robust implementation of ScopeIf. Tests a single boolean and returns a value accordingly.
eraser = Custom[ST.Tool.Eraser](VARList=scopeIf)  # package Synthesize toolkit; Try to delete any element from project
debug_python = Custom[Debug Python]()  # package Synthesize toolkit; Debug Python
