# Dynamo graph Topography.Surfaces To Subregions.dyn (Dynamo 2.13.1.3887)
# author: karam@aecedx.com
# packages: Synthesize toolkit 12.5.1

# group: Input
n01_select_surfaces = DSModelElementsSelection()  # "01.Select Surfaces"; nothing selected; graph input
n02_select_topography = DSModelElementSelection()  # "02.Select Topography"; nothing selected; graph input
n03_number_of_subregions_in_each = DoubleInput(10)  # "03.Number of Subregions in Each Transaction"; graph input

turnIntoList = Custom[CW.TurnIntoList](VARunknownItem=n01_select_surfaces)  # package Synthesize toolkit; Turns an element (or a nested list) into a flat list
code_block = CodeBlock { "ImportInstance"; }
filterByString = Custom[ST.List.FilterByString](VARlist=turnIntoList, VARString=code_block)  # package Synthesize toolkit; Filter a list by a string match
element_geometry_fixer = Custom[Element.Geometry Fixer](VARElement=filterByString.VARMatch)  # package Synthesize toolkit; Element.Geometry Fixer
code_block_2 = CodeBlock { "Autodesk.DesignScript.Geometry.Surface"; }
removeIfNot = List.RemoveIfNot(list=element_geometry_fixer@L2, type=code_block_2)
flatten = List.Flatten(list=removeIfNot)
perimeterCurves = Surface.PerimeterCurves(surface=flatten)
code_block_3 = CodeBlock { 0; }
curves_offset_to_revit = Custom[Curves Offset To Revit Compatibility](VARCurves=perimeterCurves, VAROffset=code_block_3)  # package Synthesize toolkit; Curves Offset To Revit Compatibility
select_topography_from_subregion = Custom[Select Topography From Subregion](VARTopography=n02_select_topography)  # package Synthesize toolkit; Select Topography From Subregion
boundingBox = Element.BoundingBox(element=select_topography_from_subregion)
toCuboid = BoundingBox.ToCuboid(boundingBox=boundingBox)
centerPoint = Custom[ZK.BoundingBox.CenterPoint](VARBoundingBox=boundingBox)  # package Synthesize toolkit; Input Bounding Box element to get its center point. This node is little and lightweight, as it doesn't convert bounding box to geometry to get its centroid point.
XYZ = Custom[LF.Point.XYZ](VARpoint=centerPoint)  # package Synthesize toolkit; Get the X, Y, and Z components of a Point
byCoordinates = Point.ByCoordinates(z=XYZ.VARZ)
byOrigin = CoordinateSystem.ByOrigin(origin=byCoordinates)
byJoinedCurves = PolyCurve.ByJoinedCurves(curves=curves_offset_to_revit.VARCurves)
byGeometry = BoundingBox.ByGeometry(geom=byJoinedCurves)
centerPoint_2 = Custom[ZK.BoundingBox.CenterPoint](VARBoundingBox=byGeometry)
XYZ_2 = Custom[LF.Point.XYZ](VARpoint=centerPoint_2)
byCoordinates_2 = Point.ByCoordinates(z=XYZ_2.VARZ)
byOrigin_2 = CoordinateSystem.ByOrigin(origin=byCoordinates_2)
transform = Geometry.Transform(geometry=toCuboid, fromCoordinateSystem=byOrigin, contextCoordinateSystem=byOrigin_2)
boundingBox_2 = Geometry.BoundingBox(geometry=transform)
code_block_4 = CodeBlock { 0..1..0.1; }
pointAtParameter = Curve.PointAtParameter(curve=byJoinedCurves@L1, param=code_block_4)
contains = BoundingBox.Contains(boundingBox=boundingBox_2, point=pointAtParameter@L2)
allFalse = List.AllFalse(list=contains@L2)
filterByBoolMask = List.FilterByBoolMask(list=curves_offset_to_revit.VARRevitCurves, mask=allFalse)
subregions_batch_create = Custom[Subregions Batch Create](VARRevitCurves=filterByBoolMask.out, VARNumberofSubregionsinEachGroup=n03_number_of_subregions_in_each, VARTopography=select_topography_from_subregion)  # package Synthesize toolkit; Subregions Batch Create
debug_python = Custom[Debug Python]()  # package Synthesize toolkit; Debug Python
