# Dynamo graph Views.Analyse Underlay By Visual Data.dyn (Dynamo 2.13.1.3887)
# author: karam@aecedx.com
# packages: Synthesize toolkit 12.5.1

# group: Input
n08_create_selection_filter = BoolSelector(true)  # "08.Create Selection Filter ?"; graph input
n09_selection_filter_name = StringInput("Dynmo Analyse Visual Underlay")  # "09.Selection Filter Name"; graph input
n07_linestyle_to_use = StringInput("Wide Lines")  # "07.Linestyle To Use"; graph input
n01_select_scope_box = DSModelElementSelection()  # "01.Select Scope Box"; nothing selected; graph input
n1_exact_name_2_contains_name_3 = DoubleSlider(1, range=1..3 step 1)  # "1 = Exact Name | 2 = Contains Name | 3 = All"
n03_exact_name = StringInput("Level 1")  # "03.Exact Name"; graph input
n02_false_floor_plan_true_ceiling = BoolSelector(false)  # "02.False = Floor Plan | True = Ceiling Plan"; graph input
n04_unbounded_distance = DoubleInput(50)  # "04.Unbounded Distance"; graph input
n05_overriding_pattern = FillPatterns("<Solid fill>")  # "05.Overriding Pattern"; graph input
transparency = IntegerSlider(50, range=0..100 step 1)  # "06.Transparency"; graph input

code_block = CodeBlock { false; }
default_linestyles_name_revit = Custom[Default Linestyles Name Revit Compatiblity](VARLinestylename=n07_linestyle_to_use)  # package Synthesize toolkit; Default Linestyles Name Revit Compatiblity
underlay_visual_analyse = Custom[Underlay Visual Analyse](VARLinestyleToUse=default_linestyles_name_revit, VARScopeBox=n01_select_scope_box, VAR1ExactName2ContainsName3All=n1_exact_name_2_contains_name_3, VARName=n03_exact_name, VARFalseFloorPlansTrueCeilingPlans=n02_false_floor_plan_true_ceiling, VARUnboundedDistance=n04_unbounded_distance)  # package Synthesize toolkit; Underlay Visual Analyse
generate_selection_filter = Custom[Generate Selection Filter](VARCreateSelectionFilter=n08_create_selection_filter, VARFilterNametoCreate=n09_selection_filter_name, VAROverwriteExistingFilter=code_block, VARElements=underlay_visual_analyse.VARDetailCurve)  # package Synthesize toolkit; Generate Selection FIlter
code_block_2 = CodeBlock { "Range: Base Level"; }
getParameterValueByName = Element.GetParameterValueByName(element=underlay_visual_analyse.VARView, parameterName=code_block_2)
passthrough = Custom[CW.Passthrough](VARpassThrough=underlay_visual_analyse.VARView, VARwaitFor=getParameterValueByName)  # package Synthesize toolkit; Forces a sequential order of execution. The node wired into the output of the Passthrough node will be executed *after* the node wired into the waitFor input (e.g. important for some Revit operations). The value of the passThrough input will be passed on to the node wired into the output port of the Passthrough node.
turnIntoList = Custom[CW.TurnIntoList](VARunknownItem=passthrough)  # package Synthesize toolkit; Turns an element (or a nested list) into a flat list
python_script = Python(IN[0]=turnIntoList)  # IronPython2
# ---------- python_script.python (17 lines) ----------
import clr
clr.AddReference("RevitAPI")
from Autodesk.Revit.DB import *
clr.AddReference("RevitServices")
import RevitServices
from RevitServices.Persistence import DocumentManager
from RevitServices.Transactions import TransactionManager
#The inputs to this node will be stored as a list in the IN variables.
elements = UnwrapElement(IN[0])
doc = DocumentManager.Instance.CurrentDBDocument
TransactionManager.Instance.EnsureInTransaction(doc)
for view in elements:
    #view.get_Parameter(BuiltInParameter.VIEW_UNDERLAY_ID).Set(ElementId.InvalidElementId)
    view.SetUnderlayRange(ElementId.InvalidElementId,ElementId.InvalidElementId)
TransactionManager.Instance.TransactionTaskDone()
#Assign your output to the OUT variable.
OUT = 0
# ----------------------------------------
end = Revit.Transaction.Transaction.End(input=python_script)
python_script_2 = Python(IN[0]=underlay_visual_analyse.VARView, IN[1]=end)  # IronPython2
# ---------- python_script_2.python (39 lines) ----------
# Enable Python support and load DesignScript library
# IMPORTANT : ALL DYNAMO DESIGN SCRIPT NODES ARE AS (dg)
import clr
clr.AddReference('ProtoGeometry')
from Autodesk.DesignScript import Geometry as dg

# EXTENSION Enable ToDSType
clr.AddReference('RevitNodes')
import Revit
clr.ImportExtensions(Revit.Elements)

# Enable Revit Elements
from Revit.Elements import *

# EXTENSION Enable Geometry Conversion Methods
clr.ImportExtensions(Revit.GeometryConversion)

# Enable Revit API
clr.AddReference('RevitAPI')
from Autodesk.Revit.DB import *

# Enable DocumentManager and TransactionManager
clr.AddReference('RevitServices')
from RevitServices.Persistence import DocumentManager
from RevitServices.Transactions import TransactionManager

# Enable ICollection List Translate
clr.AddReference("System")
import System.Collections.Generic
from System.Collections.Generic import List

view = UnwrapElement(IN[0])

doc = DocumentManager.Instance.CurrentDBDocument

collector = FilteredElementCollector(doc,view[0].Id).ToElements();

#Assign your output to the OUT variable.
OUT = collector,view
# ----------------------------------------
code_block_3 = CodeBlock(a=python_script_2) { a[0]; a[1]; }
colorPicker = Custom[RH.UI.ColorPicker]()  # package Synthesize toolkit; This node allows the user to choose a color via the Revit API color selection dialog. For Revit 2017 +
byProperties = Revit.Filter.OverrideGraphicSettings.ByProperties(cutFillColor=colorPicker.VARdynamoColor, projectionFillColor=colorPicker.VARdynamoColor, cutLineColor=colorPicker.VARdynamoColor, projectionLineColor=colorPicker.VARdynamoColor, cutFillPattern=n05_overriding_pattern, projectionFillPattern=n05_overriding_pattern, transparency=transparency)
overrideInView = Element.OverrideInView(element=code_block_3.out0, overrides=byProperties)
element_setparameterbyname_fixer = Custom[Element.SetParameterByName Fixer](VARelement=code_block_3.out1, VARparameterName=code_block_2, VARvalue=getParameterValueByName)  # package Synthesize toolkit; Element.SetParameterByName Fixer
debug_python = Custom[Debug Python]()  # package Synthesize toolkit; Debug Python
