# Dynamo graph Views.Analyse View Range By Visual Data .dyn "Views.Analyse View Range By Visual Data" (Dynamo 2.13.1.3887)
# author: karam@aecedx.com
# packages: Synthesize toolkit 12.5.1

# group: Input
n11_create_selection_filter = BoolSelector(true)  # "11.Create Selection Filter ?"; graph input
n12_filter_name_to_create = StringInput("Dynamo Analyse Visual View Range")  # "12.Filter Name To Create"; graph input
n02_false_floor_plans_true = BoolSelector(false)  # "02.False = Floor Plans | True = Ceiling Plans"; graph input
n10_category_of_visual_elements = Categories("OST_Furniture")  # "10.Category of Visual Elements"; graph input
n07_depth_range_material = StringInput("Depth Material")  # "07.Depth Range Material"; graph input
n06_cut_range_material = StringInput("Cut Material")  # "06.Cut Range Material"; graph input
n05_top_range_material = StringInput("Top Material")  # "05.Top Range Material"; graph input
name = StringInput("Level 1")  # "04.Name"; graph input
n01_select_scope_box = DSModelElementSelection()  # "01.Select Scope Box"; nothing selected; graph input
n03_1_exact_name_2_contains_name = DoubleSlider(1, range=1..3 step 1)  # "03.1 = Exact Name | 2 = Contains Name | 3 = All"; graph input
n09_unlimited_bottom_depth = DoubleInput(-4)  # "09.Unlimited Bottom/Depth Visualize Distance"; graph input
n08_unlimited_top_visualize = DoubleInput(4)  # "08.Unlimited Top Visualize Distance"; graph input

code_block = CodeBlock { false; }
code_block_2 = CodeBlock { 190; 255; 125; }
byARGB = Color.ByARGB(red=code_block_2.out0, green=code_block_2.out1, blue=code_block_2.out2)
code_block_3 = CodeBlock { 50; }
create_material_if_not_existed = Custom[Create Material If Not Existed](VARMaterialName=n07_depth_range_material, VARMaterialColorToUseIfNotExisted=byARGB, VARMaterialTransparancyToUseIfNotExisted=code_block_3)  # package Synthesize toolkit; Create Material If Not Existed
name_2 = Material.Name(material=create_material_if_not_existed.VARMaterial)
code_block_4 = CodeBlock { 115; 155; 255; }
byARGB_2 = Color.ByARGB(red=code_block_4.out0, green=code_block_4.out1, blue=code_block_4.out2)
create_material_if_not_existed_2 = Custom[Create Material If Not Existed](VARMaterialName=n06_cut_range_material, VARMaterialColorToUseIfNotExisted=byARGB_2, VARMaterialTransparancyToUseIfNotExisted=code_block_3)
name_3 = Material.Name(material=create_material_if_not_existed_2.VARMaterial)
code_block_5 = CodeBlock { 255; 255; 120; }
byARGB_3 = Color.ByARGB(red=code_block_5.out0, green=code_block_5.out1, blue=code_block_5.out2)
create_material_if_not_existed_3 = Custom[Create Material If Not Existed](VARMaterialName=n05_top_range_material, VARMaterialColorToUseIfNotExisted=byARGB_3, VARMaterialTransparancyToUseIfNotExisted=code_block_3)
name_4 = Material.Name(material=create_material_if_not_existed_3.VARMaterial)
view_range_visual_analyse = Custom[View Range Visual Analyse](VARFalseFloorPlansTrueCeilingPlans=n02_false_floor_plans_true, VARCategory=n10_category_of_visual_elements, VARDepthMaterial=name_2, VARCutMaterial=name_3, VARTopMaterial=name_4, VARName=name, VARScopeBox=n01_select_scope_box, VAR1ExactName2ContainsName3All=n03_1_exact_name_2_contains_name, VARUnlimitedBottomDepthDistance=n09_unlimited_bottom_depth, VARUnlimitedTopDistance=n08_unlimited_top_visualize)  # package Synthesize toolkit; View Range Visual Analyse
flatten = List.Flatten(list=view_range_visual_analyse)
generate_selection_filter = Custom[Generate Selection Filter](VARCreateSelectionFilter=n11_create_selection_filter, VARFilterNametoCreate=n12_filter_name_to_create, VAROverwriteExistingFilter=code_block, VARElements=flatten)  # package Synthesize toolkit; Generate Selection FIlter
debug_python = Custom[Debug Python]()  # package Synthesize toolkit; Debug Python
