# Dynamo graph Views.Misc Crop Regions to Detail Lines.dyn (Dynamo 2.13.1.3887)
# author: karam@aecedx.com
# packages: Synthesize toolkit 12.5.1

# group: Input
n02_draw_in_plan_views = BoolSelector(true)  # "02.Draw In Plan Views"; graph input
n03_1_exact_name_2_contains_name = IntegerSlider(3, range=1..3 step 1)  # "03.1 = Exact Name | 2 = Contains Name | 3 = All"; graph input
n04_plan_view_name = StringInput("Level 1")  # "04.Plan View Name"; graph input
n11_draw_in_ceiling_views = BoolSelector(true)  # "11.Draw In Ceiling Views"; graph input
n12_1_exact_name_2_contains_name = IntegerSlider(3, range=1..3 step 1)  # "12.1 = Exact Name | 2 = Contains Name | 3 = All"; graph input
n13_ceiling_view_name = StringInput("Level 1")  # "13.Ceiling View Name"; graph input
n20_draw_in_structural_views = BoolSelector(true)  # "20.Draw In Structural Views"; graph input
n21_1_exact_name_2_contains_name = IntegerSlider(3, range=1..3 step 1)  # "21.1 = Exact Name | 2 = Contains Name | 3 = All"; graph input
n22_structural_view_name = StringInput("Level 1")  # "22.Structural View Name"; graph input
n14_draw_in_area_views = BoolSelector(true)  # "14.Draw In Area Views"; graph input
n15_1_exact_name_2_contains_name = IntegerSlider(3, range=1..3 step 1)  # "15.1 = Exact Name | 2 = Contains Name | 3 = All"; graph input
n16_area_view_name = StringInput("Level 1")  # "16.Area View Name"; graph input
n05_draw_in_elevation_views = BoolSelector(true)  # "05.Draw In Elevation Views"; graph input
n06_1_exact_name_2_contains_name = IntegerSlider(3, range=1..3 step 1)  # "06.1 = Exact Name | 2 = Contains Name | 3 = All"; graph input
n07_elevation_view_name = StringInput("North")  # "07.Elevation View Name"; graph input
n08_draw_in_section_views = BoolSelector(true)  # "08.Draw In Section Views"; graph input
n09_1_exact_name_2_contains_name = IntegerSlider(3, range=1..3 step 1)  # "09.1 = Exact Name | 2 = Contains Name | 3 = All"; graph input
n10_section_view_name = StringInput("Section 1")  # "10.Section View Name"; graph input
n17_draw_in_detail_views = BoolSelector(true)  # "17.Draw In Detail Views"; graph input
n18_1_exact_name_2_contains_name = IntegerSlider(3, range=1..3 step 1)  # "18.1 = Exact Name | 2 = Contains Name | 3 = All"; graph input
n19_detail_view_name = StringInput("Detail 0")  # "19.Detail View Name"; graph input
n01_clean_up_everything_mode = BoolSelector(false)  # "01.Clean Up Everything Mode (False to Draw CropLines)"; graph input

python_script = Python(IN[0]=n02_draw_in_plan_views, IN[1]=n03_1_exact_name_2_contains_name, IN[2]=n04_plan_view_name, IN[3]=n11_draw_in_ceiling_views, IN[4]=n12_1_exact_name_2_contains_name, IN[5]=n13_ceiling_view_name, IN[6]=n20_draw_in_structural_views, IN[7]=n21_1_exact_name_2_contains_name, IN[8]=n22_structural_view_name, IN[9]=n14_draw_in_area_views, IN[10]=n15_1_exact_name_2_contains_name, IN[11]=n16_area_view_name, IN[12]=n05_draw_in_elevation_views, IN[13]=n06_1_exact_name_2_contains_name, IN[14]=n07_elevation_view_name, IN[15]=n08_draw_in_section_views, IN[16]=n09_1_exact_name_2_contains_name, IN[17]=n10_section_view_name, IN[18]=n17_draw_in_detail_views, IN[19]=n18_1_exact_name_2_contains_name, IN[20]=n19_detail_view_name, IN[21]=n01_clean_up_everything_mode)  # IronPython2
# ---------- python_script.python (304 lines) ----------
# Code By Karam Baki, karam@aecedx.com

import clr
# EXTENSION Enable ToDSType
clr.AddReference('RevitNodes')
import Revit
clr.ImportExtensions(Revit.Elements)

# EXTENSION Enable Geometry Conversion Methods
clr.ImportExtensions(Revit.GeometryConversion)

# Enable ICollection List Translate
clr.AddReference("System")
import System.Collections.Generic
from System.Collections.Generic import List

# Enable Revit API
clr.AddReference('RevitAPI')
from Autodesk.Revit.DB import *

# Enable DocumentManager and TransactionManager
clr.AddReference('RevitServices')
from RevitServices.Persistence import DocumentManager
from RevitServices.Transactions import TransactionManager

class WarnSwallow(IFailuresPreprocessor):
	def PreprocessFailures(self, failuresAccessor):
		failuresAccessor.DeleteAllWarnings()
		return FailureProcessingResult.Continue

def flatten(x):
    result = []
    for el in x:
        if hasattr(el, "__iter__") and not isinstance(el, basestring):
            result.extend(flatten(el))
        else:
            result.append(el)
    return result
    
# Choose The Current Document
doc = DocumentManager.Instance.CurrentDBDocument

cleanupmode = IN[21]

selsetname = "Dynamo-CropLines"
if cleanupmode == True:
	TransactionManager.Instance.ForceCloseTransaction()
	trans1 = Transaction(doc, 'Cleaning Up CropLines')
	trans1.Start()
	foptions =trans1.GetFailureHandlingOptions()
	foptions.SetFailuresPreprocessor(WarnSwallow())
	trans1.SetFailureHandlingOptions(foptions)
	collector = FilteredElementCollector(doc)
	filters = collector.OfClass(FilterElement).ToElements()
	found = False
	for each in filters:
		if each.Name.lower() == selsetname.lower():
			selset = each
			found = True
			break
	if found == True:
		elemids = selset.GetElementIds()
		numberofelements = len(elemids)
		if numberofelements > 0:
			for e in elemids:
				doc.Delete(e)
			doc.Delete(selset.Id)
			OUT = "Cleaned Up " + str(numberofelements) + " Detail Lines" + " And Selection Filter " + selsetname
		else:
			doc.Delete(selset.Id)
			OUT = "Cleaned Up" + " Selection Filter " + selsetname + " Only"
	else:
		OUT = "Nothing to Clean"
	trans1.Commit()
else:
	#collect all views in the model
	collector = FilteredElementCollector(doc)
	views = collector.OfClass(View).ToElements()
	 
	#sort views into separate lists based on view type
	areaPlans, ceilingPlans, columnSchedules = [], [], []
	costReport, details, draftingViews = [], [], []
	drawingSheets, elevations, engineetingPlans = [], [], []
	floorPlans, internal, legends, loadReports = [], [], [], []
	panelSchedules, pressureLossReports, renderings = [], [], []
	reports, schedules, sections, threeD = [], [], [], []
	undefined, walkthrough = [], []
	for i in views:
		if not i.IsTemplate:
			if i.ViewType == ViewType.AreaPlan:
				areaPlans.append(i.ToDSType(True))
			elif i.ViewType == ViewType.CeilingPlan:
				ceilingPlans.append(i.ToDSType(True))
			elif i.ViewType == ViewType.ColumnSchedule:
				columnSchedules.append(i.ToDSType(True))
			elif i.ViewType == ViewType.CostReport:
				costReport.append(i.ToDSType(True))
			elif i.ViewType == ViewType.Detail:
				details.append(i.ToDSType(True))
			elif i.ViewType == ViewType.DraftingView:
				draftingViews.append(i.ToDSType(True))
			elif i.ViewType == ViewType.DrawingSheet:
				drawingSheets.append(i.ToDSType(True))
			elif i.ViewType == ViewType.Elevation:
				elevations.append(i.ToDSType(True))
			elif i.ViewType == ViewType.EngineeringPlan:
				engineetingPlans.append(i.ToDSType(True))
			elif i.ViewType == ViewType.FloorPlan:
				floorPlans.append(i.ToDSType(True))
			elif i.ViewType == ViewType.Internal:
				internal.append(i.ToDSType(True))
			elif i.ViewType == ViewType.Legend:
				legends.append(i.ToDSType(True))
			elif i.ViewType == ViewType.LoadsReport:
				loadReports.append(i.ToDSType(True))
			elif i.ViewType == ViewType.PanelSchedule:
				panelSchedules.append(i.ToDSType(True))
			elif i.ViewType == ViewType.PresureLossReport:
				pressureLossReports.append(i.ToDSType(True))
			elif i.ViewType == ViewType.Rendering:
				renderings.append(i.ToDSType(True))
			elif i.ViewType == ViewType.Report:
				reports.append(i.ToDSType(True))
			elif i.ViewType == ViewType.Schedule:
				schedules.append(i.ToDSType(True))
			elif i.ViewType == ViewType.Section:
				sections.append(i.ToDSType(True))
			elif i.ViewType == ViewType.ThreeD:
				threeD.append(i.ToDSType(True))
			elif i.ViewType == ViewType.Undefined:
				undefined.append(i.ToDSType(True))
			elif i.ViewType == ViewType.Walkthrough:
				walkthrough.append(i.ToDSType(True))
			else:
				continue
	
	overrideplans = IN[0]
	planscond = IN[1]
	planname = IN[2].lower()
	
	newfloorPlans = []
	if overrideplans == True:
		for e in floorPlans:
			if planscond == 1:
				if e.Name.lower() == planname:
					newfloorPlans.append(e)
			elif planscond == 2:
				if planname in e.Name.lower():
					newfloorPlans.append(e)
			elif planscond == 3:
				newfloorPlans.append(e)
	
	overrideceilings = IN[3]
	ceilingscond = IN[4]
	ceilingname = IN[5].lower()
	
	newceilingPlans = []
	if overrideceilings == True:
		for e in ceilingPlans:
			if ceilingscond == 1:
				if e.Name.lower() == ceilingname:
					newceilingPlans.append(e)
			elif ceilingscond == 2:
				if ceilingname in e.Name.lower():
					newceilingPlans.append(e)
			elif ceilingscond == 3:
				newceilingPlans.append(e)
	
	overrideengineeting = IN[6]
	engineetingscond = IN[7]
	engineetingname = IN[8].lower()	
	
	newengineetingPlans = []
	if overrideengineeting == True:
		for e in engineetingPlans:
			if engineetingscond == 1:
				if e.Name.lower() == engineetingname:
					newengineetingPlans.append(e)
			elif engineetingscond == 2:
				if engineetingname in e.Name.lower():
					newengineetingPlans.append(e)
			elif engineetingscond == 3:
				newengineetingPlans.append(e)		
				
	overridearea = IN[9]
	areascond = IN[10]
	areaname = IN[11].lower()	
	
	newareaPlans = []
	if overridearea == True:
		for e in areaPlans:
			if areascond == 1:
				if e.Name.lower() == areaname:
					newareaPlans.append(e)
			elif areascond == 2:
				if areaname in e.Name.lower():
					newareaPlans.append(e)
			elif areascond == 3:
				newareaPlans.append(e)
	
	overrideelvs = IN[12]
	elvsscond = IN[13]
	elvsname = IN[14].lower()	
	
	newelvs = []
	if overrideelvs == True:
		for e in elevations:
			if elvsscond == 1:
				if e.Name.lower() == elvsname:
					newelvs.append(e)
			elif elvsscond == 2:
				if elvsname in e.Name.lower():
					newelvs.append(e)
			elif elvsscond == 3:
				newelvs.append(e)
	
	overridesec = IN[15]
	secscond = IN[16]
	secsname = IN[17].lower()	
	
	newsections = []
	if overridesec == True:
		for e in sections:
			if secscond == 1:
				if e.Name.lower() == secsname:
					newsections.append(e)
			elif secscond == 2:
				if secsname in e.Name.lower():
					newsections.append(e)
			elif secscond == 3:
				newsections.append(e)
				
	overridedet = IN[18]
	detscond = IN[19]
	detname = IN[20].lower()	
	
	newdets = []
	if overridedet == True:
		for e in details:
			if detscond == 1:
				if e.Name.lower() == detname:
					newdets.append(e)
			elif detscond == 2:
				if detname in e.Name.lower():
					newdets.append(e)
			elif detscond == 3:
				newdets.append(e)
	
	result = newfloorPlans + newceilingPlans + newengineetingPlans + newareaPlans + newelvs + newsections + newdets
	
	TransactionManager.Instance.ForceCloseTransaction()
	trans1 = Transaction(doc, 'Karam\'s CropLines Magic')
	trans1.Start()
	foptions =trans1.GetFailureHandlingOptions()
	foptions.SetFailuresPreprocessor(WarnSwallow())
	trans1.SetFailureHandlingOptions(foptions)
	
	count = 0
	itemset = []
	for r in result:
		try:
			unwraped = UnwrapElement(r)
			if unwraped.CropBoxActive  == True:
				croploop = unwraped.GetCropRegionShapeManager().GetCropShape()
				if len(croploop) != 0:
					croparray = CurveArray()
					croploop = croploop[0]
					for c in croploop:
						croparray.Append(c)
					itemset.append(doc.Create.NewDetailCurveArray(unwraped,croparray))
					count += 1
		except:
			pass
	try:
		goodoutput = False
		if len(itemset) != 0:
			goodoutput = True
			collector = FilteredElementCollector(doc)
			filters = collector.OfClass(FilterElement).ToElements()
			found = False
			for each in filters:
				if each.Name.lower() == selsetname.lower():
					selset = each
					found = True
					break
			itemset = flatten(itemset)
			itemsetids = []
			for item in itemset:
				itemsetids.append(item.Id)
			itemsetids = List[ElementId](itemsetids)
			if found == False:
				selset = SelectionFilterElement.Create(doc,selsetname)
			selset.AddSet(itemsetids)
	except:
		pass
	trans1.Commit()
	if goodoutput:
		if count > 1:
			loop = "Loops"
		else:
			loop = "Loop"
		OUT = "Created " + str(count) + " " + loop + " , Also Selection Filter With Name " + '"' + selsetname + '"'
	else:
		OUT = "No Crop Regions Found"
# ----------------------------------------

# group: Output
report = Watch(python_script)  # "01.Report"; graph output

debug_python_no_message = Custom[Debug Python No Message]()  # package Synthesize toolkit; Debug Python
