# Dynamo graph Views.Misc K-Plan.dyn (Dynamo 2.13.1.3887)
# author: karam@aecedx.com
# packages: Synthesize toolkit 12.6.3

# group: Input
n04_rotation_degree = DoubleSlider(20, range=-360..360 step 1)  # "04.Rotation Degree"; graph input
n02_suffix_of_duplicated_view = StringInput("K-Plan")  # "02.Suffix of Duplicated View ?"; graph input
n01_select_axis_line = DSModelElementSelection()  # "01.Select Axis Line"; 1 picked in the model; graph input
n03_with_detailing = BoolSelector(true)  # "03.With Detailing ?"; graph input

current = Document.Current()
activeView = Document.ActiveView(document=current)
name = Element.Name(element=activeView)
code_block = CodeBlock(a=name, c=n02_suffix_of_duplicated_view) { a+" "+c; }
python_script = Python(IN[0]=code_block)  # IronPython2
# ---------- python_script.python (55 lines) ----------
import clr

# EXTENSION Enable ToDSType
clr.AddReference('RevitNodes')
import Revit

# Enable Revit API
clr.AddReference('RevitAPI')
from Autodesk.Revit.DB import *

# Enable DocumentManager and TransactionManager
clr.AddReference('RevitServices')
from RevitServices.Persistence import DocumentManager
from RevitServices.Transactions import TransactionManager

def tolist(obj1):
	if hasattr(obj1,'__iter__'): return obj1
	else: return [obj1]

def flatten(x):
    result = []
    for el in x:
        if hasattr(el, "__iter__") and not isinstance(el, basestring):
            result.extend(flatten(el))
        else:
            result.append(el)
    return result

names = flatten(tolist(IN[0]))

boolresult = []

if len(names) > 0:
	if len(names) == 1 and names[0] == None:
		pass
	else:
		if isinstance(IN[0], list):
			single = False
		else:
			single = True
		doc = DocumentManager.Instance.CurrentDBDocument
		views = FilteredElementCollector(doc).OfClass(View).WhereElementIsNotElementType().ToElements()
		for name in names:
			tmp = []
			status = False
			for view in views:
				if (view != None and view.IsTemplate == False):
					if name.lower() == view.Name.lower():
						status = True
						break
			boolresult.append(status)
			if single:
				boolresult = boolresult[0]
#Assign your output to the OUT variable.
OUT = boolresult
# ----------------------------------------
empty = List.Empty()
scopeIf = Custom[CW.ScopeIf+](VARtest=python_script, VARtrue=empty, VARfalse=n01_select_axis_line)  # package Synthesize toolkit; A (hopefully) more robust implementation of ScopeIf. Tests a single boolean and returns a value accordingly.
k_plan = Custom[K-Plan](VARRotationDegree=n04_rotation_degree, VARAxisModelLine=scopeIf, VARDetailing=n03_with_detailing, VARSuffix=n02_suffix_of_duplicated_view)  # package Synthesize toolkit; K-Plan
debug_python_no_message = Custom[Debug Python No Message]()  # package Synthesize toolkit; Debug Python
code_block_2 = CodeBlock { "K-Plan View Already Exists"; }
empty_2 = List.Empty()
scopeIf_2 = Custom[CW.ScopeIf+](VARtest=python_script, VARtrue=code_block_2, VARfalse=empty_2)
alert_popup = Custom[Alert Popup](VARMessage=scopeIf_2)  # package Synthesize toolkit; Popup a message dialog in Revit
