# Dynamo graph Views.Rename By Associated Levels.dyn (Dynamo 2.13.1.3887)
# author: karam@aecedx.com
# packages: Synthesize toolkit 12.5.1

# group: Input
n12_proceed = BoolSelector(false)  # "12.Proceed ?"; graph input
n01_element_types = ElementTypes("ViewPlan")  # "01.Element Types"; graph input
n02_filter_parameter = StringInput("Sync with Dynamo")  # "02.Filter Parameter"; graph input
n16_view_name_parameter = StringInput("View Name")  # "16.View Name Parameter"; graph input
n05_associated_parameter_prefix = StringInput("")  # "05.Associated Parameter Prefix"; graph input
n04_count_of_chars_to_remove_from = DoubleInput(0)  # "04.Count of Chars to Remove From Associated Parameter"; graph input
n17_assosciated_parameter_name = StringInput("Associated Level")  # "17.Assosciated Parameter Name"; graph input
n03_start_index_to_remove = DoubleInput(0)  # "03.Start Index to Remove Associated Parameter"; graph input
n06_assosiated_parameter_suffix = StringInput("")  # "06.Assosiated Parameter Suffix"; graph input
n09_current_views_name_prefix = StringInput("")  # "09.Current Views Name Prefix"; graph input
n08_count_of_chars_to_remove_from = DoubleInput(0)  # "08.Count of Chars to Remove From Current Views Name"; graph input
n07_start_index_to_remove_current = DoubleInput(0)  # "07.Start Index to Remove Current Views Name"; graph input
n10_current_views_name_suffix = StringInput("")  # "10.Current Views Name Suffix"; graph input
n11_index_to_insert_the = DoubleInput(0)  # "11.Index to Insert The Associated Parameter's Name to The Current Views Name"; graph input
n13_write_a_backup_to_csv = BoolSelector(false)  # "13.Write a Backup to CSV"; graph input
n14_overrides_file = StringInput("C:\Users\karam\Desktop\Dynamo Views Backup Values.csv")  # "14.Overrides File"; graph input
n15_overwrite_existing_excel_file = BoolSelector(false)  # "15.Overwrite Existing Excel File"; graph input

all_elements_of_type = ElementsOfType(element_type=n01_element_types)
getParameterValueByName = Element.GetParameterValueByName(element=all_elements_of_type, parameterName=n02_filter_parameter)
code_block = CodeBlock { 1; }
eq = getParameterValueByName == code_block
filterByBoolMask = List.FilterByBoolMask(list=all_elements_of_type, mask=eq)
code_block_2 = CodeBlock { null; false; }
scopeIf = Custom[CW.ScopeIf+](VARtest=n12_proceed, VARtrue=filterByBoolMask.in, VARfalse=code_block_2.out0)  # package Synthesize toolkit; A (hopefully) more robust implementation of ScopeIf. Tests a single boolean and returns a value accordingly.
clean = List.Clean(list=scopeIf, preserveIndices=code_block_2.out1)
scopeIf_2 = Custom[CW.ScopeIf+](VARtest=n12_proceed, VARtrue=n16_view_name_parameter, VARfalse=code_block_2.out0)
clean_2 = List.Clean(list=scopeIf_2, preserveIndices=code_block_2.out1)
getParameterValueByName_2 = Element.GetParameterValueByName(element=filterByBoolMask.in, parameterName=n17_assosciated_parameter_name)
remove = String.Remove(string=getParameterValueByName_2, startIndex=n03_start_index_to_remove)  # unwired: count
map = List.Map(list=n04_count_of_chars_to_remove_from, f_x=remove)
code_block_3 = CodeBlock { ""; }
isNull = Object.IsNull()  # unwired: object
replaceByCondition = Replace(item=map, replaceWith=code_block_3, condition=isNull)
flatten = List.Flatten(list=replaceByCondition)
code_block_4 = CodeBlock(a=n05_associated_parameter_prefix, b=flatten) { a+b; }
code_block_5 = CodeBlock(a=code_block_4, b=n06_assosiated_parameter_suffix) { a+b; }
getParameterValueByName_3 = Element.GetParameterValueByName(element=filterByBoolMask.in, parameterName=n16_view_name_parameter)
code_block_6 = CodeBlock { ""; }
eq_2 = getParameterValueByName_3 == code_block_6
bk_replace_item_if_true = Custom[BK.Replace Item if True](VARlist1=code_block_5, VARlist2=getParameterValueByName_3, VARbooleanlist=eq_2)  # package Synthesize toolkit; takes two lists, plus a boolean list. If the boolean list says True, list1 item is replaced by list2 item
create = List.Create(item0=bk_replace_item_if_true.VARnewList)
remove_2 = String.Remove(string=getParameterValueByName_3, startIndex=n07_start_index_to_remove_current)  # unwired: count
map_2 = List.Map(list=n08_count_of_chars_to_remove_from, f_x=remove_2)
code_block_7 = CodeBlock { ""; }
isNull_2 = Object.IsNull()  # unwired: object
replaceByCondition_2 = Replace(item=map_2, replaceWith=code_block_7, condition=isNull_2)
flatten_2 = List.Flatten(list=replaceByCondition_2)
code_block_8 = CodeBlock(a=n09_current_views_name_prefix, b=flatten_2) { a+b; }
code_block_9 = CodeBlock(a=code_block_8, b=n10_current_views_name_suffix) { a+b; }
code_block_10 = CodeBlock { ""; }
eq_3 = getParameterValueByName_3 == code_block_10
bk_replace_item_if_true_2 = Custom[BK.Replace Item if True](VARlist1=code_block_9, VARlist2=getParameterValueByName_3, VARbooleanlist=eq_3)
insert = String.Insert(string=bk_replace_item_if_true_2.VARnewList, index=n11_index_to_insert_the)  # unwired: toInsert
map_3 = List.Map(list=create, f_x=insert)
code_block_11 = CodeBlock { ""; }
isNull_3 = Object.IsNull()  # unwired: object
replaceByCondition_3 = Replace(item=map_3, replaceWith=code_block_11, condition=isNull_3)
flatten_3 = List.Flatten(list=replaceByCondition_3)
scopeIf_3 = Custom[CW.ScopeIf+](VARtest=n12_proceed, VARtrue=flatten_3, VARfalse=code_block_2.out0)
clean_3 = List.Clean(list=scopeIf_3, preserveIndices=code_block_2.out1)
setParameterByName = Element.SetParameterByName(element=clean, parameterName=clean_2, value=clean_3, lacing=Longest)
length = String.Length(string=flatten)
length_2 = String.Length(string=bk_replace_item_if_true.VARnewList)
length_3 = String.Length(string=flatten_2)
length_4 = String.Length(string=bk_replace_item_if_true_2.VARnewList)

# group: Report
n01_associated_levels_before_pre = Watch(flatten)  # "01.Associated Levels Before Pre/Suffix"; graph output
n02_associated_levels_string = Watch(length)  # "02.Associated Levels String Length Before Pre/Suffix"; graph output
n03_associated_levels_after_pre = Watch(bk_replace_item_if_true.VARnewList)  # "03.Associated Levels After Pre/Suffix"; graph output
n04_associated_levels_string = Watch(length_2)  # "04.Associated Levels String Length After Pre/Suffix"; graph output
n05_current_views_names_before = Watch(flatten_2)  # "05.Current Views' Names Before Pre/Suffix"; graph output
n06_current_views_string_length = Watch(length_3)  # "06.Current Views' String Length Before Pre/Suffix"; graph output
n07_current_views_names_after_pre = Watch(bk_replace_item_if_true_2.VARnewList)  # "07.Current Views' Names After Pre/Suffix"; graph output
n08_current_views_string_length = Watch(length_4)  # "08.Current Views' String Length After Pre/Suffix"; graph output
n09_resulted_names = Watch(flatten_3)  # "09.Resulted Names"; graph output

code_block_12 = CodeBlock { null; false; }
scopeIf_4 = Custom[CW.ScopeIf+](VARtest=n13_write_a_backup_to_csv, VARtrue=n14_overrides_file, VARfalse=code_block_12.out0)
create_2 = List.Create(item0=scopeIf_4)
code_block_13 = CodeBlock { null; false; }
join = List.Join()  # unwired: list0, list1
id = Element.Id(element=filterByBoolMask.in)
combine = List.Combine(comb=join, list1=id, list2=getParameterValueByName_3)
fileExists = FileSystem.FileExists(path=n14_overrides_file)
fromPath = FileObject(path=n14_overrides_file)  # "File.FromPath"
code_block_14 = CodeBlock { null; }
scopeIf_5 = Custom[CW.ScopeIf+](VARtest=fileExists, VARtrue=fromPath, VARfalse=code_block_14)
create_3 = List.Create(item0=scopeIf_5)
code_block_15 = CodeBlock { false; }
clean_4 = List.Clean(list=create_3, preserveIndices=code_block_15)
flatten_4 = List.Flatten(list=clean_4)
importCSV = Data.ImportCSV(filePath=flatten_4)
flatten_5 = List.Flatten(list=importCSV@L2)
join_2 = List.Join(list0=combine, list1=flatten_5)
uniqueItems = List.UniqueItems(list=join_2)
code_block_16 = CodeBlock { "ProtoCore.DSASM.StackValue"; }
eq_4 = uniqueItems == code_block_16
filterByBoolMask_2 = List.FilterByBoolMask(list=uniqueItems, mask=eq_4)
code_block_17 = CodeBlock { false; }
clean_5 = List.Clean(list=filterByBoolMask_2.out, preserveIndices=code_block_17)
firstItem = List.FirstItem(list=clean_5@L2)
al_duplicate_item_indices = Custom[AL.Duplicate Item Indices](VARList=firstItem)  # package Synthesize toolkit; Searches an input list for duplicate entries and lists their index numbers. Couple with Get From List to delete duplicates from a list.
getItemAtIndex = List.GetItemAtIndex(list=clean_5, index=al_duplicate_item_indices.VARUniqueIndices)
scopeIf_6 = Custom[CW.ScopeIf+](VARtest=n13_write_a_backup_to_csv, VARtrue=getItemAtIndex, VARfalse=code_block_12.out0)
clean_6 = List.Clean(list=scopeIf_6, preserveIndices=code_block_12.out1)
scopeIf_7 = Custom[CW.ScopeIf+](VARtest=n15_overwrite_existing_excel_file, VARtrue=code_block_13.out0, VARfalse=clean_6)
scopeIf_8 = Custom[CW.ScopeIf+](VARtest=n15_overwrite_existing_excel_file, VARtrue=combine, VARfalse=code_block_13.out0)
join_3 = List.Join(list0=scopeIf_7, list1=scopeIf_8)
clean_7 = List.Clean(list=join_3, preserveIndices=code_block_13.out1)
exportCSV = Data.ExportCSV(data=clean_7)  # unwired: filePath
map_4 = List.Map(list=create_2, f_x=exportCSV)
debug_python = Custom[Debug Python]()  # package Synthesize toolkit; Debug Python
