# Dynamo graph Views.Rename By Pre-Suffix Add and String Remove.dyn (Dynamo 2.13.1.3887)
# author: karam@aecedx.com
# packages: Synthesize toolkit 12.5.1

# group: Input
n07_proceed = BoolSelector(false)  # "07.Proceed ?"; graph input
n01_element_types = ElementTypes("ViewPlan")  # "01.Element Types"; graph input
n02_filter_parameter = StringInput("Sync with Dynamo")  # "02.Filter Parameter"; graph input
n11_view_name_parameter = StringInput("View Name")  # "11.View Name Parameter"; graph input
n05_current_views_name_prefix = StringInput("")  # "05.Current Views Name Prefix"; graph input
n04_count_of_chars_to_remove_from = DoubleInput(0)  # "04.Count of Chars to Remove From Current Views Name"; graph input
n03_start_index_to_remove_current = DoubleInput(0)  # "03.Start Index to Remove Current Views Name"; graph input
n06_current_views_name_suffix = StringInput("")  # "06.Current Views Name Suffix"; graph input
n08_write_a_backup_to_csv = BoolSelector(false)  # "08.Write a Backup to CSV"; graph input
n09_overrides_file = StringInput("C:\Users\karam\Desktop\Dynamo Views Backup Values.csv")  # "09.Overrides File"; graph input
n10_overwrite_existing_excel_file = BoolSelector(false)  # "10.Overwrite Existing Excel File"; graph input

all_elements_of_type = ElementsOfType(element_type=n01_element_types)
getParameterValueByName = Element.GetParameterValueByName(element=all_elements_of_type, parameterName=n02_filter_parameter)
code_block = CodeBlock { 1; }
eq = getParameterValueByName == code_block
filterByBoolMask = List.FilterByBoolMask(list=all_elements_of_type, mask=eq)
code_block_2 = CodeBlock { null; false; }
scopeIf = Custom[CW.ScopeIf+](VARtest=n07_proceed, VARtrue=filterByBoolMask.in, VARfalse=code_block_2.out0)  # package Synthesize toolkit; A (hopefully) more robust implementation of ScopeIf. Tests a single boolean and returns a value accordingly.
clean = List.Clean(list=scopeIf, preserveIndices=code_block_2.out1)
scopeIf_2 = Custom[CW.ScopeIf+](VARtest=n07_proceed, VARtrue=n11_view_name_parameter, VARfalse=code_block_2.out0)
clean_2 = List.Clean(list=scopeIf_2, preserveIndices=code_block_2.out1)
getParameterValueByName_2 = Element.GetParameterValueByName(element=filterByBoolMask.in, parameterName=n11_view_name_parameter)
remove = String.Remove(string=getParameterValueByName_2, startIndex=n03_start_index_to_remove_current)  # unwired: count
map = List.Map(list=n04_count_of_chars_to_remove_from, f_x=remove)
code_block_3 = CodeBlock { ""; }
isNull = Object.IsNull()  # unwired: object
replaceByCondition = Replace(item=map, replaceWith=code_block_3, condition=isNull)
flatten = List.Flatten(list=replaceByCondition)
code_block_4 = CodeBlock(a=n05_current_views_name_prefix, b=flatten) { a+b; }
code_block_5 = CodeBlock(a=code_block_4, b=n06_current_views_name_suffix) { a+b; }
code_block_6 = CodeBlock { ""; }
eq_2 = getParameterValueByName_2 == code_block_6
bk_replace_item_if_true = Custom[BK.Replace Item if True](VARlist1=code_block_5, VARlist2=getParameterValueByName_2, VARbooleanlist=eq_2)  # package Synthesize toolkit; takes two lists, plus a boolean list. If the boolean list says True, list1 item is replaced by list2 item
code_block_7 = CodeBlock { ""; }
isNull_2 = Object.IsNull()  # unwired: object
replaceByCondition_2 = Replace(item=bk_replace_item_if_true.VARnewList, replaceWith=code_block_7, condition=isNull_2)
flatten_2 = List.Flatten(list=replaceByCondition_2)
scopeIf_3 = Custom[CW.ScopeIf+](VARtest=n07_proceed, VARtrue=flatten_2, VARfalse=code_block_2.out0)
clean_3 = List.Clean(list=scopeIf_3, preserveIndices=code_block_2.out1)
setParameterByName = Element.SetParameterByName(element=clean, parameterName=clean_2, value=clean_3, lacing=Longest)
code_block_8 = CodeBlock { null; false; }
scopeIf_4 = Custom[CW.ScopeIf+](VARtest=n08_write_a_backup_to_csv, VARtrue=n09_overrides_file, VARfalse=code_block_8.out0)
create = List.Create(item0=scopeIf_4)
code_block_9 = CodeBlock { null; false; }
join = List.Join()  # unwired: list0, list1
id = Element.Id(element=filterByBoolMask.in)
combine = List.Combine(comb=join, list1=id, list2=getParameterValueByName_2)
fileExists = FileSystem.FileExists(path=n09_overrides_file)
fromPath = FileObject(path=n09_overrides_file)  # "File.FromPath"
code_block_10 = CodeBlock { null; }
scopeIf_5 = Custom[CW.ScopeIf+](VARtest=fileExists, VARtrue=fromPath, VARfalse=code_block_10)
create_2 = List.Create(item0=scopeIf_5)
code_block_11 = CodeBlock { false; }
clean_4 = List.Clean(list=create_2, preserveIndices=code_block_11)
flatten_3 = List.Flatten(list=clean_4)
importCSV = Data.ImportCSV(filePath=flatten_3)
flatten_4 = List.Flatten(list=importCSV@L2)
join_2 = List.Join(list0=combine, list1=flatten_4)
uniqueItems = List.UniqueItems(list=join_2)
code_block_12 = CodeBlock { "ProtoCore.DSASM.StackValue"; }
eq_3 = uniqueItems == code_block_12
filterByBoolMask_2 = List.FilterByBoolMask(list=uniqueItems, mask=eq_3)
code_block_13 = CodeBlock { false; }
clean_5 = List.Clean(list=filterByBoolMask_2.out, preserveIndices=code_block_13)
firstItem = List.FirstItem(list=clean_5@L2)
al_duplicate_item_indices = Custom[AL.Duplicate Item Indices](VARList=firstItem)  # package Synthesize toolkit; Searches an input list for duplicate entries and lists their index numbers. Couple with Get From List to delete duplicates from a list.
getItemAtIndex = List.GetItemAtIndex(list=clean_5, index=al_duplicate_item_indices.VARUniqueIndices)
scopeIf_6 = Custom[CW.ScopeIf+](VARtest=n08_write_a_backup_to_csv, VARtrue=getItemAtIndex, VARfalse=code_block_8.out0)
clean_6 = List.Clean(list=scopeIf_6, preserveIndices=code_block_8.out1)
scopeIf_7 = Custom[CW.ScopeIf+](VARtest=n10_overwrite_existing_excel_file, VARtrue=code_block_9.out0, VARfalse=clean_6)
scopeIf_8 = Custom[CW.ScopeIf+](VARtest=n10_overwrite_existing_excel_file, VARtrue=combine, VARfalse=code_block_9.out0)
create_3 = List.Create(item0=scopeIf_7, item1=scopeIf_8)
clean_7 = List.Clean(list=create_3, preserveIndices=code_block_9.out1)
flatten_5 = List.Flatten(list=clean_7)
exportCSV = Data.ExportCSV(data=flatten_5)  # unwired: filePath
map_2 = List.Map(list=create, f_x=exportCSV)
length = String.Length(string=getParameterValueByName_2)

# group: Report
n01_current_names = Watch(getParameterValueByName_2)  # "01.Current Names"; graph output
n02_current_name_string_length = Watch(length)  # "02.Current Name String Length"; graph output
n03_resulted_names = Watch(flatten_2)  # "03.Resulted Names"; graph output

debug_python = Custom[Debug Python]()  # package Synthesize toolkit; Debug Python
