# Dynamo graph Void.Auto Cut Voids with All Elements of Active View.dyn (Dynamo 2.13.1.3887)
# author: karam@aecedx.com
# packages: Synthesize toolkit 12.5.1

debug_python_no_message = Custom[Debug Python No Message]()  # package Synthesize toolkit; Debug Python

# group: Input
n01_select_void_elements = DSModelElementsSelection()  # "01.Select Void Elements"; nothing selected; graph input

python_all_elements_in_active = Custom[Python All Elements In Active View]()  # package Synthesize toolkit; Python All Elements In Active View
cut_elements = Custom[Cut Elements](VARVoids=n01_select_void_elements, VARElements=python_all_elements_in_active)  # package Synthesize toolkit; Cut Elements
