# Dynamo graph Void.Auto Cut Voids with Elements Selection.dyn (Dynamo 2.13.1.3887)
# author: karam@aecedx.com
# packages: Synthesize toolkit 12.5.1

debug_python_no_message = Custom[Debug Python No Message]()  # package Synthesize toolkit; Debug Python

# group: Input
n01_select_void_elements = DSModelElementsSelection()  # "01.Select Void Elements"; nothing selected; graph input
n02_select_elements_to_cut = DSModelElementsSelection()  # "02.Select Elements to Cut"; nothing selected; graph input

cut_elements = Custom[Cut Elements](VARVoids=n01_select_void_elements, VARElements=n02_select_elements_to_cut)  # package Synthesize toolkit; Cut Elements
