# Dynamo graph Void.Auto Cut Voids with Elements Type.dyn (Dynamo 2.13.1.3887)
# author: karam@aecedx.com
# packages: Synthesize toolkit 12.5.1

debug_python_no_message = Custom[Debug Python No Message]()  # package Synthesize toolkit; Debug Python

# group: Input
n01_select_void_elements = DSModelElementsSelection()  # "01.Select Void Elements"; nothing selected; graph input
n02_element_type = ElementTypes("Wall")  # "02.Element Type"; graph input

all_elements_of_type = ElementsOfType(element_type=n02_element_type)
cut_elements = Custom[Cut Elements](VARVoids=n01_select_void_elements, VARElements=all_elements_of_type)  # package Synthesize toolkit; Cut Elements
