# Dynamo graph Void.Auto Cut Voids with Filter Selection.dyn (Dynamo 2.13.1.3887)
# author: karam@aecedx.com
# packages: Synthesize toolkit 12.5.1

debug_python_no_message = Custom[Debug Python No Message]()  # package Synthesize toolkit; Debug Python

# group: Input
n01_select_void_elements = DSModelElementsSelection()  # "01.Select Void Elements"; nothing selected; graph input
n02_selection_filter_to_cut = StringInput("Fitler Name")  # "02.Selection Filter to Cut"; graph input

hot_get_all_filter = Custom[HOT.Get All Filter]()  # package Synthesize toolkit; Get all Filter
eq = hot_get_all_filter.VARName == n02_selection_filter_to_cut
filterByBoolMask = List.FilterByBoolMask(list=hot_get_all_filter.VARElement, mask=eq)
elements = Custom[CW.SelectionSet.Elements](VARselectionSet=filterByBoolMask.in)  # package Synthesize toolkit; Retrieves all elements stored in a selection set
flatten = List.Flatten(list=elements)
cut_elements = Custom[Cut Elements](VARVoids=n01_select_void_elements, VARElements=flatten)  # package Synthesize toolkit; Cut Elements
