# Dynamo graph Walls.Auto Miter By Function.dyn (Dynamo 2.13.1.3887)
# author: karam@aecedx.com
# packages: Synthesize toolkit 12.5.1

code_block = CodeBlock { "Walls"; }
bk_get_system_type_list_by = Custom[BK.Get System Type List by Category Name](VARcategoryName=code_block)  # package Synthesize toolkit; takes category name as string

# group: Input
n01_function_to_filter_in = StringInput("Exterior")  # "01.Function to Filter in"; graph input
n02_yes_no_filter_parameter_can = StringInput("")  # "02.Yes/No Filter Parameter (Can be empty)"; graph input

function = Custom[CW.WallType.Function](VARwallType=bk_get_system_type_list_by)  # package Synthesize toolkit; Retrieves the Function property of a given wall type
eq = n01_function_to_filter_in == function
filterByBoolMask = List.FilterByBoolMask(list=bk_get_system_type_list_by, mask=eq)
flatten = List.Flatten(list=filterByBoolMask.in)
cw_all_elements_of_family_type = Custom[CW.All Elements of Family Type+](VARfamilyType=flatten)  # package Synthesize toolkit; Unlike the built-in node, this node retrieves all placed instances of a given loadable *or* system family type
code_block_2 = CodeBlock { false; }
clean = List.Clean(list=cw_all_elements_of_family_type, preserveIndices=code_block_2)
flatten_2 = List.Flatten(list=clean)
getParameterValueByName = Element.GetParameterValueByName(element=flatten_2, parameterName=n02_yes_no_filter_parameter_can)
code_block_3 = CodeBlock { 1; ""; }
eq_2 = getParameterValueByName == code_block_3.out1
filterByBoolMask_2 = List.FilterByBoolMask(list=flatten_2, mask=eq_2)
eq_3 = getParameterValueByName == code_block_3.out0
filterByBoolMask_3 = List.FilterByBoolMask(list=flatten_2, mask=eq_3)
join = List.Join(list0=filterByBoolMask_2.in, list1=filterByBoolMask_3.in)
code_block_4 = CodeBlock { "FaceWall"; }
byClassName = Custom[SP.Filter.ByClassName](VARobject=join, VARclassName=code_block_4)  # package Synthesize toolkit; Filters a list of objects by the object's class name. Note that Dynamo elements belong to different classes than their Revit counterparts. Use the Object.Class node to check an object's class.
hot_join_type_miter = Custom[HOT.Join Type (Miter)](VARElementlist=byClassName.VARout)  # package Synthesize toolkit
debug_python = Custom[Debug Python]()  # package Synthesize toolkit; Debug Python
