# Dynamo graph Walls.Auto Miter By Selection.dyn (Dynamo 2.13.1.3887)
# author: karam@aecedx.com
# packages: Synthesize toolkit 12.5.1

# group: Input
n01_select_walls_to_auto_miter = DSModelElementsSelection()  # "01.Select Walls to Auto Miter"; nothing selected; graph input

string_from_object = FromObject(obj=n01_select_walls_to_auto_miter)
code_block = CodeBlock { "Wall"; }
eq = string_from_object == code_block
filterByBoolMask = List.FilterByBoolMask(list=n01_select_walls_to_auto_miter, mask=eq)
hot_join_type_miter = Custom[HOT.Join Type (Miter)](VARElementlist=filterByBoolMask.in)  # package Synthesize toolkit
debug_python = Custom[Debug Python]()  # package Synthesize toolkit; Debug Python
