# Dynamo graph Walls.K-Explode To Onion Walls.dyn (Dynamo 2.13.1.3887)
# author: karam@aecedx.com
# packages: Synthesize toolkit 12.5.1

hot_get_all_filter = Custom[HOT.Get All Filter]()  # package Synthesize toolkit; Get all Filter

# group: Input
n01_parts_filter_to_read = StringInput("Dynamo-Parts")  # "01.Parts filter to read"; graph input
n02_function_of_walls_to_look_for = StringInput("Exterior")  # "02.Function of walls to look for"; graph input
proceed = BoolSelector(false)  # "05.Proceed"; graph input
n03_material_parameter_to_read = StringInput("Comments")  # "03.Material Parameter to Read"; graph input
n04_filter_name_to_create_for_old = StringInput("Dynamo-Original Walls")  # "04.Filter name to create for old walls"; graph input

eq = hot_get_all_filter.VARName == n01_parts_filter_to_read
filterByBoolMask = List.FilterByBoolMask(list=hot_get_all_filter.VARElement, mask=eq)
elements = Custom[CW.SelectionSet.Elements](VARselectionSet=filterByBoolMask.in)  # package Synthesize toolkit; Retrieves all elements stored in a selection set
flatten = List.Flatten(list=elements)
getparents = Custom[ST.Parts.Getparents](VARParts=flatten)  # package Synthesize toolkit; Returns parents of selected Parts
code_block = CodeBlock { "Wall"; }
byClassName = Custom[SP.Filter.ByClassName](VARobject=getparents, VARclassName=code_block)  # package Synthesize toolkit; Filters a list of objects by the object's class name. Note that Dynamo elements belong to different classes than their Revit counterparts. Use the Object.Class node to check an object's class.
getparents_2 = Custom[ST.Parts.Getparents](VARParts=byClassName.VARout)
join = List.Join(list0=byClassName.VARin, list1=getparents_2)
code_block_2 = CodeBlock { "Type"; }
getParameterValueByName = Element.GetParameterValueByName(element=join, parameterName=code_block_2)
code_block_3 = CodeBlock { "Walls"; }
bk_get_system_type_list_by = Custom[BK.Get System Type List by Category Name](VARcategoryName=code_block_3)  # package Synthesize toolkit; takes category name as string
function = Custom[CW.WallType.Function](VARwallType=bk_get_system_type_list_by)  # package Synthesize toolkit; Retrieves the Function property of a given wall type
eq_2 = function == n02_function_of_walls_to_look_for
filterByBoolMask_2 = List.FilterByBoolMask(list=bk_get_system_type_list_by, mask=eq_2)
contains = List.Contains(list=getParameterValueByName@L1, item=filterByBoolMask_2.in, lacing=CrossProduct)
anyTrue = Custom[CW.List.AnyTrue](VARseq=contains)  # package Synthesize toolkit; Returns true if any item in a list of booleans is true.
filterByBoolMask_3 = List.FilterByBoolMask(list=flatten, mask=anyTrue)
geometry = Element.Geometry(element=filterByBoolMask_3.in)
explode = Geometry.Explode(geometry=geometry)
filterByOrientation = Custom[CW.Surface.FilterByOrientation](VARsurfaces=explode)  # package Synthesize toolkit; Sorts surfaces in three lists based on their orientation (vertical, horizontal up & horizontal down) and also returns three corresponding lists of booleans.
flatten_2 = List.Flatten(list=filterByOrientation.VARhorizontalDown)
perimeterCurves = Surface.PerimeterCurves(surface=flatten_2)
length = Curve.Length(curve=perimeterCurves)
maximumItem = List.MaximumItem(list=length)
join_2 = List.Join()  # unwired: list0, list1
code_block_4 = CodeBlock { 2; }
chop = List.Chop(lengths=code_block_4)  # unwired: list
map = List.Map(list=perimeterCurves, f_x=chop)
chop_2 = List.Chop(lengths=code_block_4)  # unwired: list
map_2 = List.Map(list=length, f_x=chop_2)
maximumItem_2 = List.MaximumItem()  # unwired: list
map_3 = List.Map(list=map_2, f_x=maximumItem_2)
eq_3 = map_2 == map_3
filterByBoolMask_4 = List.FilterByBoolMask(list=map, mask=eq_3)
flatten_3 = List.Flatten()  # unwired: list
map_4 = List.Map(list=filterByBoolMask_4.out, f_x=flatten_3)
code_block_5 = CodeBlock { 0.5; }
pointAtParameter = Curve.PointAtParameter(curve=map_4, param=code_block_5)
flatten_4 = List.Flatten()  # unwired: list
map_5 = List.Map(list=filterByBoolMask_4.in, f_x=flatten_4)
pointAtParameter_2 = Curve.PointAtParameter(curve=map_5, param=code_block_5)
byBestFitThroughPoints = Line.ByBestFitThroughPoints()  # unwired: bestFitPoints
map_6 = List.Map(list=pointAtParameter_2, f_x=byBestFitThroughPoints)
pointAtParameter_3 = Curve.PointAtParameter(curve=map_6, param=code_block_5)
combine = List.Combine(comb=join_2, list1=pointAtParameter, list2=pointAtParameter_3)
byBestFitThroughPoints_2 = Arc.ByBestFitThroughPoints()  # unwired: points
map_7 = List.Map(list=combine, f_x=byBestFitThroughPoints_2)
isNull = Object.IsNull(object=map_7)
filterByBoolMask_5 = List.FilterByBoolMask(list=map_7, mask=isNull)
filterByBoolMask_6 = List.FilterByBoolMask(list=combine, mask=isNull)
byBestFitThroughPoints_3 = Line.ByBestFitThroughPoints()  # unwired: bestFitPoints
map_8 = List.Map(list=filterByBoolMask_6.in, f_x=byBestFitThroughPoints_3)
join_3 = List.Join(list0=filterByBoolMask_5.out, list1=map_8)
watch = 03.Watch(filterByBoolMask_3.in)  # graph output
code_block_6 = CodeBlock { "Height"; "Base Level"; }
getParameterValueByName_2 = Element.GetParameterValueByName(element=watch, parameterName=code_block_6.out0)
code_block_7 = CodeBlock { null; false; }
scopeIf = Custom[CW.ScopeIf+](VARtest=proceed, VARtrue=getParameterValueByName_2, VARfalse=code_block_7.out0)  # package Synthesize toolkit; A (hopefully) more robust implementation of ScopeIf. Tests a single boolean and returns a value accordingly.
clean = List.Clean(list=scopeIf, preserveIndices=code_block_7.out1)
filterByBoolMask_7 = List.FilterByBoolMask(list=clean, mask=isNull)
join_4 = List.Join(list0=filterByBoolMask_7.out, list1=filterByBoolMask_7.in)
getParameterValueByName_3 = Element.GetParameterValueByName(element=watch, parameterName=code_block_6.out1)
scopeIf_2 = Custom[CW.ScopeIf+](VARtest=proceed, VARtrue=getParameterValueByName_3, VARfalse=code_block_7.out0)
clean_2 = List.Clean(list=scopeIf_2, preserveIndices=code_block_7.out1)
filterByBoolMask_8 = List.FilterByBoolMask(list=clean_2, mask=isNull)
join_5 = List.Join(list0=filterByBoolMask_8.out, list1=filterByBoolMask_8.in)
wall_type_parameter_in_parts_to = StringInput("Material")  # "Wall Type Parameter in Parts to look for"
getParameterValueByName_4 = Element.GetParameterValueByName(element=watch, parameterName=wall_type_parameter_in_parts_to)
getParameterValueByName_5 = Element.GetParameterValueByName(element=getParameterValueByName_4, parameterName=n03_material_parameter_to_read)
byName = WallType.ByName()  # unwired: name
map_9 = List.Map(list=getParameterValueByName_5, f_x=byName)
scopeIf_3 = Custom[CW.ScopeIf+](VARtest=proceed, VARtrue=map_9, VARfalse=code_block_7.out0)
clean_3 = List.Clean(list=scopeIf_3, preserveIndices=code_block_7.out1)
filterByBoolMask_9 = List.FilterByBoolMask(list=clean_3, mask=isNull)
join_6 = List.Join(list0=filterByBoolMask_9.out, list1=filterByBoolMask_9.in)
byCurveAndHeight = Wall.ByCurveAndHeight(curve=join_3, height=join_4, level=join_5, wallType=join_6)
filterByBoolMask_10 = List.FilterByBoolMask(list=getparents, mask=anyTrue)
uniqueItems = List.UniqueItems(list=filterByBoolMask_10.in)
code_block_8 = CodeBlock { null; }
scopeIf_4 = Custom[CW.ScopeIf+](VARtest=proceed, VARtrue=uniqueItems, VARfalse=code_block_8)
scopeIf_5 = Custom[CW.ScopeIf+](VARtest=proceed, VARtrue=code_block, VARfalse=code_block_8)
byClassName_2 = Custom[SP.Filter.ByClassName](VARobject=scopeIf_4, VARclassName=scopeIf_5)
getparents_3 = Custom[ST.Parts.Getparents](VARParts=byClassName_2.VARout)
byClassName_3 = Custom[SP.Filter.ByClassName](VARobject=getparents_3, VARclassName=scopeIf_5)
uniqueItems_2 = List.UniqueItems(list=byClassName_3.VARin)
join_7 = List.Join(list0=byClassName_2.VARin, list1=uniqueItems_2)
byElements = Custom[CW.SelectionSet.ByElements](VARName=n04_filter_name_to_create_for_old, VARelements=join_7)  # package Synthesize toolkit; Creates a selection set of the given elements. Note that if a selection set of the given name already exists in the model, its contents will be replaced. Also, if the selection set is already applied as a view filter, the view filter will have to be manually updated in the visibility / graphic overrides. DO ***NOT*** USE IN AUTOMATIC MODE!
passthrough = Custom[CW.Passthrough](VARpassThrough=byClassName_2.VARin, VARwaitFor=explode)  # package Synthesize toolkit; Forces a sequential order of execution. The node wired into the output of the Passthrough node will be executed *after* the node wired into the waitFor input (e.g. important for some Revit operations). The value of the passThrough input will be passed on to the node wired into the output port of the Passthrough node.
code_block_9 = CodeBlock { false; }
passthrough_2 = Custom[CW.Passthrough](VARpassThrough=code_block_9, VARwaitFor=explode)
allowDisallowWallJoinAtEnd = Custom[HOT.AllowDisallowWallJoinAtEnd](VARElements=passthrough, VARBool=passthrough_2)  # package Synthesize toolkit; Allow/Disallow Wall Join At End. True=Allow.WallJoinAtEnd False=Disallow.WallJoinAtEnd
count = List.Count(list=filterByBoolMask_3.in)

# group: Report
n01_number_of_new_exploded_walls = Watch(count)  # "01.Number of New Exploded Walls from Parts of the Full walls"; graph output

watch_2 = 02.Watch(filterByBoolMask_4.out)  # graph output
flatten_5 = List.Flatten()  # unwired: list
map_10 = List.Map(list=watch_2, f_x=flatten_5)
watch_3 = 04.Watch(filterByBoolMask_5.out)  # graph output

# group: Usage
notes = StringInput("""1- Use Walls.Auto Miter

2- Use Parts.Create 

3- Load the parts filter created from Parts.Create

4- Divide by levels 

5- Use Parts.Level Auto Fix

6- Reuse Parts.Create again

7- Load the parts filter again created from Parts.Create

8- Deselect and Reselect, then save to a new selection set (Name it X for example)

9- Use Walls.K-Explode now, and choose the filter "X" you created in previous step

10- Load Original Walls filter created by Walls.K-Explode, and delete or keep them for future reference

-Karam Baki""")  # "06.Notes"; graph input

debug_python = Custom[Debug Python]()  # package Synthesize toolkit; Debug Python
