# Dynamo graph Walls.Wall By Surfaces Selection (Wall By Face).dyn (Dynamo 2.13.1.3887)
# author: karam@aecedx.com
# packages: Synthesize toolkit 12.5.1

debug_python_no_message = Custom[Debug Python No Message]()  # package Synthesize toolkit; Debug Python

# group: Input
n01_select_faces = SelectFaces()  # "01.Select Faces"; nothing selected; graph input
n02_fetch_whole_body = BoolSelector(false)  # "02.Fetch Whole Body ?"; graph input
n03_faces_filter_1_vertical_faces = IntegerSlider(4, range=1..4 step 1)  # "03.Faces Filter (1 = Vertical Faces | 2 = Horizontal Up Faces | 3 = Horizontal Down Faces | 4 = All Faces)"; graph input
n04_wall_types = WallTypes()  # "04.Wall Types"; nothing selected; graph input
n05_wall_location = WallLocation("FinishFaceExterior")  # "05.Wall Location"; graph input

code_block = CodeBlock { 2022; }
update_revit_wait = Custom[Update Revit Wait](VARWait=n01_select_faces, VARVersion=code_block)  # package Synthesize toolkit; Update Revit Wait
all_surfaces_or_surface = Custom[All Surfaces or Surface Filtering](VARSurfaces=update_revit_wait, VARFetchWholeBody=n02_fetch_whole_body, VAROrienataion=n03_faces_filter_1_vertical_faces)  # package Synthesize toolkit; All Surfaces or Surface Filtering
python_script = Python(IN[0]=all_surfaces_or_surface.VARRevitFaceReference, IN[1]=n04_wall_types, IN[2]=n05_wall_location)  # IronPython2
# ---------- python_script.python (128 lines) ----------
# Enable Python support and load DesignScript library
# IMPORTANT : ALL DYNAMO DESIGN SCRIPT NODES ARE AS (dg)
import clr
clr.AddReference('ProtoGeometry')
from Autodesk.DesignScript import Geometry as dg

# EXTENSION Enable ToDSType
clr.AddReference('RevitNodes')
import Revit
clr.ImportExtensions(Revit.Elements)

# Enable Revit Elements
from Revit.Elements import *

# EXTENSION Enable Geometry Conversion Methods
clr.ImportExtensions(Revit.GeometryConversion)

# Enable Revit API
clr.AddReference('RevitAPI')
from Autodesk.Revit.DB import *

# Enable DocumentManager and TransactionManager
clr.AddReference('RevitServices')
from RevitServices.Persistence import DocumentManager
from RevitServices.Transactions import TransactionManager

# Enable ICollection List Translate
clr.AddReference("System")
import System.Collections.Generic
from System.Collections.Generic import List

class WarnSwallow(IFailuresPreprocessor):
	def PreprocessFailures(self, failuresAccessor):
		fmas = failuresAccessor.GetFailureMessages()
		if len(fmas) == 0:
			self.__warn = []
			return FailureProcessingResult.Continue
		else:
			probs = []
			isgood = True
			for fma in fmas:
				sev = str(fma.GetSeverity())
				fails = list(fma.GetFailingElementIds())
				felems = []
				for f in fails:
					felems.append(doc.GetElement(f))
				if str(sev) == "Warning": 
					failuresAccessor.ResolveFailure(fma)
					failuresAccessor.DeleteWarning(fma)
				else:
					isgood = False
					probs.append(felems) 
				self.__warn = probs
		if isgood:
			return FailureProcessingResult.ProceedWithCommit
		else:
			return FailureProcessingResult.ProceedWithRollBack 

def tolist(obj1):
	if hasattr(obj1,'__iter__'): return obj1
	else: return [obj1]

def flatten(x):
    result = []
    for el in x:
        if hasattr(el, "__iter__") and not isinstance(el, basestring):
            result.extend(flatten(el))
        else:
            result.append(el)
    return result

dataEnteringNode = IN
# Use UnwrapElement(IN[0]) When Translating From Dynamo to Revit
refs=UnwrapElement(flatten(tolist(IN[0])))
walltype=UnwrapElement(IN[1])
location=UnwrapElement(IN[2])


if location == "WallCenterline":
	location = WallLocationLine.WallCenterline

if location == "CoreCenterline":
	location = WallLocationLine.CoreCenterline

if location == "FinishFaceExterior":
	location = WallLocationLine.FinishFaceExterior

if location == "FinishFaceInterior":
	location = WallLocationLine.FinishFaceInterior

if location == "CoreExterior":
	location = WallLocationLine.CoreExterior

if location == "CoreInterior":
	location = WallLocationLine.CoreInterior

#if location == "WallCenterline":

# Choose The Current Document
doc = DocumentManager.Instance.CurrentDBDocument
uidoc = DocumentManager.Instance.CurrentUIApplication.ActiveUIDocument
uiapp = DocumentManager.Instance.CurrentUIApplication
app = uiapp.Application

# Create Empty List
result = []

TransactionManager.Instance.ForceCloseTransaction()
TransactionManager.Instance.ForceCloseTransaction()
tGroup = TransactionGroup(doc, 'Dynamo Wall By Face')
tGroup.Start()
trans = Transaction(doc, 'Dynamo Wall By Face')
for r in refs:
	trans.Start()
	warnhandle = WarnSwallow()
	foptions = trans.GetFailureHandlingOptions()
	foptions.SetFailuresPreprocessor(warnhandle)
	foptions.SetClearAfterRollback(True)
	trans.SetFailureHandlingOptions(foptions)
	try:
		result.append(FaceWall.Create(doc,walltype.Id,location,r))
	except:
		pass
	trans.Commit()
tGroup.Assimilate()

# Assign your output to the OUT variable.
OUT = result
# ----------------------------------------
