# Dynamo custom node SystemList.dyf (Dynamo 0.8.1.1942)
# category: Revit.Systems
# Takes MEPSystem elements and displays Information about each system to use in Dynamo.
# Created by Michael Cox at NG Bailey.

Elements = Input()
python_script = Python(IN[0]=Elements)
# ---------- python_script.python (18 lines) ----------
import clr
clr.AddReference('RevitAPI')
from Autodesk.Revit.DB import *

items = UnwrapElement(IN[0])
sysName, sysCategory, sysEquipment, sysEquipmentCount, sysFamilyTemp = [], [], [], [], ""

for item in items:
	sysName.append(item.Name)
	sysCategory.append(item.Category.Name)
	sysFamilyTemp = item.BaseEquipment.Symbol.Family.Name
	for equipment in item.Elements:
		sysFamilyTemp = sysFamilyTemp + ", " + equipment.Symbol.Family.Name
	sysEquipment.append(sysFamilyTemp)
	sysEquipmentCount.append(item.Elements.Size + 1)
	sysFamilyTemp = ""

OUT = sysName, sysCategory, sysEquipment, sysEquipmentCount
# ----------------------------------------
code_block = CodeBlock(OUT=python_script) { OUT[0]; OUT[1]; OUT[2]; OUT[3]; }
System_Name = Output(code_block.out0)
System_Category = Output(code_block.out1)
System_Equipment = Output(code_block.out2)
System_Elements = Output(code_block.out3)
