# Dynamo graph Building.dyn "Sample" (Dynamo 2.0.3.8810)

file_path = Filename(".\sample.rsd")  # graph input
byRsdFile = TestFit.Building.ByRsdFile(fileName=file_path)
polycurves = TestFit.Building.Polycurves(building=byRsdFile)
integer_slider = IntegerSlider(6, range=0..107 step 1)  # graph input
eq = polycurves.types == integer_slider
filterByBoolMask = List.FilterByBoolMask(list=polycurves.polycurves, mask=eq)
clean = List.Clean(list=filterByBoolMask.in)
elementTypeName = TestFit.Building.ElementTypeName(elementType=integer_slider)
watch = Watch(elementTypeName)
