# Dynamo custom node BackgroundText.Thickened.dyf (Dynamo 0.8.2.2225)
# category: Testing Waters
# Graphic text in background preview. Content , height and placement point of text to be specified.

function_thickened_text = CodeBlock()
# ---------- function_thickened_text.designscript (6 lines) ----------
def AlDl(strSl:var[]..[],fontheight,base:var[]..[])
{
sl=AlSl(strSl,fontheight,base);
dl=PolyCurve.ByThickeningCurve(sl,fontheight/10,Vector.ZAxis());
return=Solid.ByUnion(dl.ExtrudeAsSolid(Vector.ZAxis(),fontheight/10));
};
# ----------------------------------------
function_single_line_text = CodeBlock()
# ---------- function_single_line_text.designscript (340 lines) ----------
def AlSl(str:string,fontheight,base)
{
return=[Imperative]
{
st={};
cn=0;
fx=base.X;
fy=base.Y;
fz=base.Z;
fw=fontheight/1.5;
fh=fontheight;
gap=fontheight/4;
spacing=gap+fw;

for (ix in str)
{
P10=Point.ByCoordinates(fx,fy,fz);
P11=Point.ByCoordinates(fx,fy+fh/4,fz);
P12=Point.ByCoordinates(fx,fy+fh/2,fz);
P13=Point.ByCoordinates(fx,fy+3*fh/4,fz);
P20=Point.ByCoordinates(fx,fy+fh,fz);
P21=Point.ByCoordinates(fx+fw/4,fy+fh,fz);
P22=Point.ByCoordinates(fx+fw/2,fy+fh,fz);
P23=Point.ByCoordinates(fx+3*fw/4,fy+fh,fz);
P30=Point.ByCoordinates(fx+fw,fy+fh,fz);
P31=Point.ByCoordinates(fx+fw,fy+3*fh/4,fz);
P32=Point.ByCoordinates(fx+fw,fy+fh/2,fz);
P33=Point.ByCoordinates(fx+fw,fy+fh/4,fz);
P40=Point.ByCoordinates(fx+fw,fy,fz);
P41=Point.ByCoordinates(fx+3*fw/4,fy,fz);
P42=Point.ByCoordinates(fx+fw/2,fy,fz);
P43=Point.ByCoordinates(fx+fw/4,fy,fz);
P51=Point.ByCoordinates(fx+fw/4,fy+fh/2,fz);
P52=Point.ByCoordinates(fx+fw/2,fy+fh/2,fz);
P53=Point.ByCoordinates(fx+3*fw/4,fy+fh/2,fz);


a={PolyCurve.ByPoints({P10,P13,P21,P23,P31,P40}),Line.ByStartPointEndPoint(P11,P33)};
b={PolyCurve.ByPoints({P10,P20,P23,P31,P53,P33,P41,P43}),Line.ByStartPointEndPoint(P12,P53),Line.ByStartPointEndPoint(P43,P10)};
c={PolyCurve.ByPoints({P40,P43,P11,P13,P21,P30})};
d={PolyCurve.ByPoints({P10,P20,P23,P31,P33,P41,P43}),Line.ByStartPointEndPoint(P43,P10)};
e={PolyCurve.ByPoints({P40,P10,P20,P30}),Line.ByStartPointEndPoint(P12,P53)};
f={PolyCurve.ByPoints({P10,P20,P30}),Line.ByStartPointEndPoint(P12,P53)};
g={PolyCurve.ByPoints({P52,P32,P33,P41,P43,P11,P13,P21,P30})};
h={Line.ByStartPointEndPoint(P10,P20),Line.ByStartPointEndPoint(P30,P40),Line.ByStartPointEndPoint(P12,P32)};
i={Line.ByStartPointEndPoint(P10,P40),Line.ByStartPointEndPoint(P20,P30),Line.ByStartPointEndPoint(P22,P42)};
j={PolyCurve.ByPoints({P30,P33,P41,P43,P11})};
k={PolyCurve.ByPoints({P30,P12,P40}),Line.ByStartPointEndPoint(P10,P20)};
l={PolyCurve.ByPoints({P40,P10,P20})};
m={PolyCurve.ByPoints({P10,P20,P42,P30,P40})};
n={PolyCurve.ByPoints({P10,P20,P40,P30})};
o={PolyCurve.ByPoints({P12,P13,P21,P23,P31,P33,P41,P43,P11}),Line.ByStartPointEndPoint(P11,P12)};
p={PolyCurve.ByPoints({P10,P20,P23,P31,P53,P51}),Line.ByStartPointEndPoint(P51,P12)};
q={PolyCurve.ByPoints({P12,P13,P21,P23,P31,P33,P41,P43,P11}),Line.ByStartPointEndPoint(P11,P12),Line.ByStartPointEndPoint(P52,P40)};
r={PolyCurve.ByPoints({P10,P20,P23,P31,P53,P51}),Line.ByStartPointEndPoint(P51,P12),Line.ByStartPointEndPoint(P51,P40)};
s={PolyCurve.ByPoints({P31,P23,P21,P13,P51,P53,P33,P41,P43,P11})};
t={Line.ByStartPointEndPoint(P20,P30),Line.ByStartPointEndPoint(P22,P42)};
u={PolyCurve.ByPoints({P30,P33,P41,P43,P11,P20})};
v={PolyCurve.ByPoints({P30,P42,P20})};
w={PolyCurve.ByPoints({P30,P41,P22,P43,P20})};
x={Line.ByStartPointEndPoint(P20,P40),Line.ByStartPointEndPoint(P30,P10)};
y={Line.ByStartPointEndPoint(P20,P52),Line.ByStartPointEndPoint(P30,P10)};
z={PolyCurve.ByPoints({P20,P30,P10,P40})};
n0={PolyCurve.ByPoints({P10,P13,P21,P30,P33,P41}),PolyCurve.ByPoints({P30,P10,P41})};
n1={PolyCurve.ByPoints({P13,P22,P42}),Line.ByStartPointEndPoint(P10,P40)};
n2={PolyCurve.ByPoints({P13,P21,P23,P31,P32,P11,P10,P40})};
n3={PolyCurve.ByPoints({P13,P21,P23,P31,P53,P33,P41,P43,P11}),Line.ByStartPointEndPoint(P51,P53)};
n4={PolyCurve.ByPoints({P21,P10,P33}),Line.ByStartPointEndPoint(P53,P41)};
n5={PolyCurve.ByPoints({P30,P20,P12,P53,P33,P41,P10})};
n6={PolyCurve.ByPoints({P31,P23,P21,P13,P11,P43,P41,P33,P53}),Line.ByStartPointEndPoint(P12,P53)};
n7={PolyCurve.ByPoints({P20,P30,P41})};
n8={PolyCurve.ByPoints({P13,P21,P23,P31,P11,P43,P41,P33}),Line.ByStartPointEndPoint(P13,P33)};
n9={PolyCurve.ByPoints({P51,P13,P21,P23,P31,P33,P41,P43,P11}),Line.ByStartPointEndPoint(P51,P32)};

if (ix=="a"||ix=="A"){
st[cn]=a;
fx=fx+spacing;
cn=cn+1;
}
else{
 if(ix=="b"||ix=="B"){
 st[cn]=b;
 fx=fx+spacing;
 cn=cn+1;
 }
 else{
  if(ix=="c"||ix=="C"){
  st[cn]=c;
  fx=fx+spacing;
  cn=cn+1;
  }
  else{
   if(ix=="d"||ix=="D"){
   st[cn]=d;
   fx=fx+spacing;
   cn=cn+1;
   }
   else{
    if(ix=="e"||ix=="E"){
    st[cn]=e;
    fx=fx+spacing;
    cn=cn+1;
    }
    else{
     if(ix=="f"||ix=="F"){
     st[cn]=f;
     fx=fx+spacing;
     cn=cn+1;
     }
     else{
      if(ix=="g"||ix=="G"){
      st[cn]=g;
      fx=fx+spacing;
      cn=cn+1;
      }
      else{
       if(ix=="h"||ix=="H"){
       st[cn]=h;
       fx=fx+spacing;
       cn=cn+1;
       }
       else{
        if(ix=="i"||ix=="I"){
        st[cn]=i;
        fx=fx+spacing;
        cn=cn+1;
        }
        else{
         if(ix=="j"||ix=="J"){
         st[cn]=j;
         fx=fx+spacing;
         cn=cn+1;
         }
         else{
          if(ix=="k"||ix=="K"){
          st[cn]=k;
          fx=fx+spacing;
          cn=cn+1;
          }
          else{
           if(ix=="l"||ix=="L"){
           st[cn]=l;
           fx=fx+spacing;
           cn=cn+1;
           }
           else{
            if(ix=="m"||ix=="M"){
            st[cn]=m;
            fx=fx+spacing;
            cn=cn+1;
            }
            else{
             if(ix=="n"||ix=="N"){
             st[cn]=n;
             fx=fx+spacing;
             cn=cn+1;
             }
             else{
              if(ix=="o"||ix=="O"){
              st[cn]=o;
              fx=fx+spacing;
              cn=cn+1;
              }
              else{
               if(ix=="p"||ix=="P"){
               st[cn]=p;
               fx=fx+spacing;
               cn=cn+1;
               }
               else{
                if(ix=="q"||ix=="Q"){
                st[cn]=q;
                fx=fx+spacing;
                cn=cn+1;
                }
                else{
                 if(ix=="r"||ix=="R"){
                 st[cn]=r;
                 fx=fx+spacing;
                 cn=cn+1;
                 }
                 else{
                  if(ix=="s"||ix=="S"){
                  st[cn]=s;
                  fx=fx+spacing;
                  cn=cn+1;
                  }
                  else{
                   if(ix=="t"||ix=="T"){
                   st[cn]=t;
                   fx=fx+spacing;
                   cn=cn+1;
                   }
                   else{
                    if(ix=="u"||ix=="U"){
                    st[cn]=u;
                    fx=fx+spacing;
                    cn=cn+1;
                    }
                    else{
                     if(ix=="v"||ix=="V"){
                     st[cn]=v;
                     fx=fx+spacing;
                     cn=cn+1;
                     }
                     else{
                      if(ix=="w"||ix=="W"){
                      st[cn]=w;
                      fx=fx+spacing;
                      cn=cn+1;
                      }
                      else{
                       if(ix=="x"||ix=="X"){
                       st[cn]=x;
                       fx=fx+spacing;
                       cn=cn+1;
                       }
                       else{
                        if(ix=="y"||ix=="Y"){
                        st[cn]=y;
                        fx=fx+spacing;
                        cn=cn+1;
                        }
                        else{
                         if(ix=="z"||ix=="Z"){
                         st[cn]=z;
                         fx=fx+spacing;
                         cn=cn+1;
                         }
                         else{
                          if(ix=="0"){
                          st[cn]=n0;
                          fx=fx+spacing;
                          cn=cn+1;
                          }
                          else{
                           if(ix=="1"){
                           st[cn]=n1;
                           fx=fx+spacing;
                           cn=cn+1;
                           }
                           else{
                            if(ix=="2"){
                            st[cn]=n2;
                            fx=fx+spacing;
                            cn=cn+1;
                            }
                            else{
                             if(ix=="3"){
                             st[cn]=n3;
                             fx=fx+spacing;
                             cn=cn+1;
                             }
                             else{
                              if(ix=="4"){
                              st[cn]=n4;
                              fx=fx+spacing;
                              cn=cn+1;
                              }
                              else{
                               if(ix=="4"){
                               st[cn]=n4;
                               fx=fx+spacing;
                               cn=cn+1;
                               }
                               else{
                                if(ix=="5"){
                                st[cn]=n5;
                                fx=fx+spacing;
                                cn=cn+1;
                                }
                                else{
                                 if(ix=="6"){
                                 st[cn]=n6;
                                 fx=fx+spacing;
                                 cn=cn+1;
                                 }
                                 else{
                                  if(ix=="7"){
                                  st[cn]=n7;
                                  fx=fx+spacing;
                                  cn=cn+1;
                                  }
                                  else{
                                   if(ix=="8"){
                                   st[cn]=n8;
                                   fx=fx+spacing;
                                   cn=cn+1;
                                   }
                                   else{
                                    if(ix=="9"){
                                    st[cn]=n9;
                                    fx=fx+spacing;
                                    cn=cn+1;
                                    }
                                    else{
                                    st[cn]=" ";
                                    fx=fx+spacing;
                                    cn=cn+1;
                                     }
                                    }
                                   }
                                  }
                                 }
                                }
                               }
                              }
                             }
                            }
                           }
                          }
                         }
                        }
                       }
                      }
                     }
                    }
                   }
                  }
                 }
                }
               }
              }
             }
            }
           }
          }
         }
        }
       }
      }
     }
    }
   }
  }
 }
}
return=st;
}
};
# ----------------------------------------
text_string = Input()
text_height = Input()
text_start = Input()
thickened = CodeBlock(strng=text_string, height=text_height, BasePoint=text_start) { AlDl(strng,height,BasePoint); }
background_text = Output(thickened)
