# Dynamo custom node GetCurves.dyf (Dynamo 1.0.0.1180)
# category: Universo_BIM.Elements.BoundingBox
# Get the Horizontal and Vertical Curves from BoundingBox

BoundingBox = Input()
toCuboid = BoundingBox.ToCuboid(BoundingBox)
edges = Topology.Edges(toCuboid)
curveGeometry = Edge.CurveGeometry(edges)

# group: Vector Compare
startPoint = Curve.StartPoint(curveGeometry)
endPoint = Curve.EndPoint(curveGeometry)
byStartPointEndPoint = Line.ByStartPointEndPoint(startPoint=startPoint, endPoint=endPoint)
direction = Line.Direction(byStartPointEndPoint)
ZAxis = Vector.ZAxis()
isParallel = Vector.IsParallel(direction, ZAxis)

filterByBoolMask = List.FilterByBoolMask(list=curveGeometry, mask=isParallel)
VerticalCurves = Output(filterByBoolMask.in)
HorizontalCurves = Output(filterByBoolMask.out)
