# Dynamo custom node Vertical.IsoSurfacesAtParameter.dyf (Dynamo 1.0.0.1180)
# category: Universo_BIM.Elements.BoundingBox
# Get the Vertical IsoSurfaces from BoundingBox. Parameter 0 = Bottom / Parameter 1 = Top

BoundingBox = Input()
create = List.Create()
map = List.Map(list=BoundingBox, f_x=create)
getCurves = Custom[GetCurves](BoundingBox=map)  # Get the Horizontal and Vertical Curves from BoundingBox
flatten = Flatten()
map_2 = List.Map(list=getCurves.VerticalCurves, f_x=flatten)
Parameters = Input()
pointAtParameter = Curve.PointAtParameter(curve=map_2, param=Parameters, lacing=CrossProduct)
flatten_2 = Flatten()
map_3 = List.Map(list=pointAtParameter, f_x=flatten_2)
Z = Point.Z()
groupByFunction = GroupByFunction(map_3, Z, lacing=Longest)
byPoints = PolyCurve.ByPoints(points=groupByFunction)
flatten_3 = Flatten(byPoints)
byGeometry = BoundingBox.ByGeometry(flatten_3, lacing=Longest)
count = Count(byGeometry)
count_2 = Count(map)
code_block = CodeBlock(a=count, b=count_2) { a/b; }
chop = List.Chop(list=byGeometry, lengths=code_block)
toCuboid = BoundingBox.ToCuboid(chop)
faces = Topology.Faces()
map_4 = List.Map(list=toCuboid, f_x=faces)
flatten_4 = Flatten()
map_5 = List.Map(list=map_4, f_x=flatten_4)
surfaceGeometry = Face.SurfaceGeometry(map_5)
Surface = Output(surfaceGeometry)
