# Dynamo custom node XYZs from Adaptive Component.dyf (Dynamo 0.6.2.25263)
# category: CAAD_RWTH.Revit
# Retrieves the XYZ coordinates  of the placement points as well as the family types of adaptive component instances. Also works for pattern-based curtain panel instances that have been placed manually. Does *not* work for curtain panels hosted on a divided surface or for repeated components.

number = DoubleInput(0)
revit_document = RevitDocument(lacing=Longest)
AC = Input()
turn_into_list = Custom[Turn Into List](item=AC)  # Turns an element into a list
list = NewList(index0=revit_document, index1=turn_into_list)
python_script = Python(list)
# ---------- python_script.python (26 lines) ----------
import clr
clr.AddReference('RevitAPI')
clr.AddReference('RevitAPIUI')
from Autodesk.Revit.DB import *
import Autodesk

doc = IN[0]
aclist = IN[1]
famsymblist = list()
elementlist = list()
msg = ''
for item in aclist:
	try:
		points = item.GetFamilyPointPlacementReferences()
		pointlist = list()
		for point in points:
			pointlist.append(doc.GetElement(point.PointReference).Position)
		if len(pointlist) > 0:
			elementlist.append(pointlist)
			famsymblist.append(item.Symbol)
	except:
		msg = 'Select only adaptive components!'
if (msg != ''):
	OUT = (msg,msg)
else:
	OUT = (elementlist,famsymblist)
# ----------------------------------------
get_from_list = GetFromList(number, python_script)
XYZs = Output(get_from_list)
formula = Formula("1", lacing=Longest)
get_from_list_2 = GetFromList(formula, python_script)
FamilySymbols = Output(get_from_list_2)
