# Dynamo custom node RebarShape.GetCurves.dyf (Dynamo 1.3.2.2480)
# category: Zhukoven.Revit.Rebar
# Generate curves for the rebar shape, as used in the shape browser.

RebarShape = Input()  # Input rebar shape element
python_script = Python(IN[0]=RebarShape)
# ---------- python_script.python (31 lines) ----------
#Author Konstantin Zhukoven @ https://zhukoven.com
#Tested to work with Dynamo 1.3.0+
import clr
clr.AddReference("RevitAPI")
import Autodesk
from Autodesk.Revit.DB import *

clr.AddReference("RevitNodes")
import Revit
clr.ImportExtensions(Revit.GeometryConversion)
clr.ImportExtensions(Revit.Elements)

clr.AddReference("RevitServices")
import RevitServices
from RevitServices.Persistence import DocumentManager
from RevitServices.Transactions import TransactionManager

doc = DocumentManager.Instance.CurrentDBDocument
# "Start" the transaction
TransactionManager.Instance.EnsureInTransaction(doc)

RebarShape = UnwrapElement(IN[0])
bCurves = RebarShape.GetCurvesForBrowser()
curves = []
for i in bCurves:
	curves.append(i.ToProtoType())

# "End" the transaction
TransactionManager.Instance.TransactionTaskDone()

OUT = curves
# ----------------------------------------
Curves = Output(python_script)
