# Dynamo custom node View.ViewTemplate.dyf (Dynamo 1.2.2.373)
# category: Revit.Views.View
# gets the view template names of the view

Input = Input()
python_script = Python(IN[0]=Input)
# ---------- python_script.python (28 lines) ----------
import clr
clr.AddReference('ProtoGeometry')
from Autodesk.DesignScript.Geometry import *
clr.AddReference('RevitAPI')
from Autodesk.Revit.DB import *
clr.AddReference('RevitServices')
import RevitServices
from RevitServices.Persistence import DocumentManager
from RevitServices.Transactions import TransactionManager
clr.AddReference('RevitNodes')
#The inputs to this node will be stored as a list in the IN variables.
dataEnteringNode = IN
doc = DocumentManager.Instance.CurrentDBDocument
uiapp = DocumentManager.Instance.CurrentUIApplication
app = uiapp.Application
elements=[]
l=[]
ll=[]

builtInParmTM = BuiltInParameter.VIEW_TEMPLATE_FOR_SCHEDULE
for x in IN[0]:	
	elements.append(UnwrapElement(x))
	
for e in elements:
	l.append(e.get_Parameter(builtInParmTM).AsValueString())
	
#Assign your output to the OUT variable.
OUT = l;
# ----------------------------------------
Output = Output(python_script)  # ""
