# Dynamo custom node Collector.Area.dyf (Dynamo 1.0.0.1180)
# category: BlackBox.Collection
# Filters for Elements,Levels and Area Types to get the Areas from a Revit Model. I made the Elements as a input so that this can be used across linked files

Elements_selector = Input()  # "Elements [selector]"
Level_selector = Input()  # "Level [selector]"
Area_Type_string = Input()  # "Area Type [string]"
element_collect_by_area = Python(IN[0]=Elements_selector, IN[1]=Level_selector, IN[2]=Area_Type_string)
# ---------- element_collect_by_area.python (73 lines) ----------
#Copyright(c) 2014, Lunchbox nodes by Nathan Miller http://theprovingground.org updated by  Jason Andersen, andersen.ja@gmail.com www.serialnonstandard.com

import clr

# Import RevitAPI
clr.AddReference("RevitAPI")
import Autodesk
from Autodesk.Revit.DB import *

# Import DocumentManager and TransactionManager
clr.AddReference("RevitServices")
import RevitServices
from RevitServices.Persistence import DocumentManager
from RevitServices.Transactions import TransactionManager

# Import ToDSType(bool) extension method
clr.AddReference("RevitNodes")
import Revit
clr.ImportExtensions(Revit.Elements)
clr.ImportExtensions(Revit.GeometryConversion)

# Import ProtoGeo
import clr
clr.AddReference('ProtoGeometry')
from Autodesk.DesignScript.Geometry import *

doc =  DocumentManager.Instance.CurrentDBDocument
app =  DocumentManager.Instance.CurrentUIApplication.Application

# The input to this node will be stored in these parameters
areaElements = UnwrapElement(IN[0])
level = UnwrapElement(IN[1])
areaType = IN[2]

#Variables for collecting list
areaElems = []
areaNames = []
areaNumbers = []
areaAreas = []
areaBoundaries = []
areaLocations = []
areaNone = []

# filter elements by level then by areaType
for item in areaElements:
    if item.Parameter['Level'].AsValueString() == level.Name:
    	if item.Parameter['Area Type'].AsValueString() == areaType:
    		# if area is placed then get stuff
    		if item.Area > 0:
    			location = item.Location.Point.ToPoint()
    			boptions = Autodesk.Revit.DB.SpatialElementBoundaryOptions()
    			boundsegs = item.GetBoundarySegments(boptions)
    			boundcurves = []
    			for bound in boundsegs:
    				crvs = []
    				for seg in bound:
    					crv = seg.Curve
    					crvs.append(Revit.GeometryConversion.RevitToProtoCurve.ToProtoType( crv, True ))
    				boundcurves.append(crvs)
    			# assign your stuff to lists	
    			areaElems.append(item)
    			areaNames.append(item.Parameter['Name'].AsString())
        		areaNumbers.append(item.Number)
        		areaAreas.append(item.Area)
        		areaBoundaries.append(boundcurves)
        		areaLocations.append(location)
       		else:
       			areaNone.append("Areas not Placed")
       	else:
       		areaNone.append("Area Type not Found")
            
# List your stuff to the OUT variable
OUT = areaElems, areaNames, areaNumbers, areaAreas, areaBoundaries, areaLocations, areaNone
# ----------------------------------------
code_block = CodeBlock(element=element_collect_by_area, name=element_collect_by_area, number=element_collect_by_area, area=element_collect_by_area, boundry_lines=element_collect_by_area, location_point=element_collect_by_area, error=element_collect_by_area) { element[0]; name[1]; number[2]; area[3]; boundry_lines[4]; location_point[5]; error[6]; }
Area_Element = Output(code_block.out0)
Name = Output(code_block.out1)
Number = Output(code_block.out2)
Area = Output(code_block.out3)
Boundary_Lines = Output(code_block.out4)
Location_Point = Output(code_block.out5)
Error_s = Output(code_block.out6)  # "Error(s)"
