# Dynamo custom node Get.FlippedWall.dyf (Dynamo 0.8.1.1942)
# category: BlackBox.Get
# This node creates two lists of walls, one in which the wall has been flipped from original position and on that has not been.  It is useful in Curtain Walls that have complicated Curtain Panels

Wall_Type_string = Input()  # "Wall Type [string]"
python_script_v0_7_noelemuwrap = Python(IN[0]=Wall_Type_string)
# ---------- python_script_v0_7_noelemuwrap.python (49 lines) ----------
#Copyright(c) 2014, 
# Jason Andersen, andersen.ja@gmail.com

# Default imports
import clr
# Import RevitAPI
clr.AddReference("RevitAPI")
import Autodesk
from Autodesk.Revit.DB import *
# Import DocumentManager and TransactionManager
clr.AddReference("RevitServices")
import RevitServices
from RevitServices.Persistence import DocumentManager
from RevitServices.Transactions import TransactionManager
# Import ToDSType(bool) extension method
clr.AddReference("RevitNodes")
import Revit
clr.ImportExtensions(Revit.Elements)
doc =  DocumentManager.Instance.CurrentDBDocument
app =  DocumentManager.Instance.CurrentUIApplication.Application

#The inputs to this node will be stored as a list in the IN variable.
typname = IN[0]

collector = FilteredElementCollector(doc)
collector.OfCategory(BuiltInCategory.OST_Walls)
collector.OfClass(Wall)
 
famtypeitr = collector.GetElementIdIterator()
famtypeitr.Reset()

output = []
trues = []
falses = []
for item in famtypeitr:
    famtypeID = item
    faminst = doc.GetElement(famtypeID)
    if faminst.Name == typname:    
    	wall = faminst
    	flippedwall = faminst.Flipped
    	if flippedwall.Equals(True):
    		trues.append(wall)
    	else:
    		falses.append(wall)
    		continue  		     
output.append(trues)
output.append(falses)      
#Assign your output to the OUT variable
OUT = output
# ----------------------------------------
number = DoubleInput(0)
getItemAtIndex = List.GetItemAtIndex(list=python_script_v0_7_noelemuwrap, index=number)
Flipped = Output(getItemAtIndex)
number_2 = DoubleInput(1)
getItemAtIndex_2 = List.GetItemAtIndex(list=python_script_v0_7_noelemuwrap, index=number_2)
NOT_Flipped = Output(getItemAtIndex_2)
