# Dynamo custom node Get.Host.dyf (Dynamo 0.8.1.1942)
# category: BlackBox.Get
# get the host of am element

empty = List.Empty()
Elements = Input()
create = List.Create(empty, Elements)
flatten = Flatten(create)
py_gethost = Python(IN[0]=flatten)
# ---------- py_gethost.python (35 lines) ----------
#Copyright(c) 2014, Jason Andersen, andersen.ja@gmail.com

# Default imports
import clr
# Import RevitAPI
clr.AddReference("RevitAPI")
import Autodesk
from Autodesk.Revit.DB import *
import System.Collections.Generic
from System.Collections.Generic import List
# Import DocumentManager and TransactionManager
clr.AddReference("RevitServices")
import RevitServices
from RevitServices.Persistence import DocumentManager
from RevitServices.Transactions import TransactionManager
# Import ToDSType(bool) extension method
clr.AddReference("RevitNodes")
import Revit
clr.ImportExtensions(Revit.Elements)
doc =  DocumentManager.Instance.CurrentDBDocument
app =  DocumentManager.Instance.CurrentUIApplication.Application

#elements coming in
elementIN = IN[0]
#unwrapelements
elements = []
for i in elementIN:
    elements.append(UnwrapElement(i))
#variables
host = []
#work
for f in elements:
	fi = (f)
	host.append(fi.Host)	
OUT = host
# ----------------------------------------
flatten_2 = Flatten(py_gethost)
Hosts = Output(flatten_2)
