# Dynamo custom node Beep.dyf (Dynamo 2.5.0.7460)
# category: DynaMEP.Systems.Core
# Sound to know Procesing Dynamo

list = Input(list: var[]..[])
string_from_object = FromObject(obj=list)
python_script = Python(IN[0]=string_from_object)
# ---------- python_script.python (7 lines) ----------
#HossZamani
#Copyright(c) 2020, HossZamani
#Edited by @chuongmep, https://chuongmep.com/
import winsound
list = IN[0]
for i in list:
	winsound.Beep(list.index(i)+450, 125)
# ----------------------------------------
OUT = Output(python_script)
