# Dynamo custom node GetPointDiaLux.dyf (Dynamo 2.5.0.7460)
# category: DynaMEP.Geometry.Points
# Get Point From DiaLux
# packages: DynaMEP 1.0.9

listarr = Input(listarr: var[]..[])
python_script = Python(IN[0]=listarr)
# ---------- python_script.python (40 lines) ----------
# Carga las bibliotecas de DesignScript y normas de Python.
import sys
import clr
clr.AddReference('ProtoGeometry')
from Autodesk.DesignScript.Geometry import *

# Las entradas de este nodo se almacenan como lista en las variables IN.
dataEnteringNode = IN

# Incluya el código debajo de esta línea
arr = IN[0]

posArr = list(filter(lambda a: ("Pos" in a), arr))

def splitFn(a):
  return a.split("=")[1]

def joinPoints(p):
  return ','.join(p)

def splitPoints(c):
  return c.split()



coords = list( map(splitFn, posArr) )

pointsArr = []

print(coords)

for s in coords:
  splittedArr = splitPoints(s)
  pointsArr.append(joinPoints(splittedArr))

print(pointsArr)

OUT = pointsArr

# Asigne la salida a la variable OUT.
# ----------------------------------------
transpose = List.Transpose(lists=python_script)
code_block = CodeBlock { ","; }
split = String.Split(str=transpose, separator0=code_block)
stringToNumber = List.String.StringToNumber(str=split)
transpose_2 = List.Transpose(lists=stringToNumber)
code_block_2 = CodeBlock(a=transpose_2) { a[0]*1000; a[1]*1000; a[2]*1000; }
byCoordinates = Point.ByCoordinates(x=code_block_2.out0, y=code_block_2.out1, z=code_block_2.out2)
Points = Output(byCoordinates)
