# Dynamo custom node Bridge_body_split_by_constant_distance.dyf (Dynamo 2.10.1.3976)
# category: Dynabridge

The_alignment_in_form_of_curve = Input(The_alignment_in_form_of_curve: var[]..[])
The_number_of_profiles_in_the_family = Input(The_number_of_profiles_in_the_family: var[]..[])
Bridge_segment_legnth = Input(Bridge_segment_legnth: var[]..[])
python_script = Python(IN[0]=The_alignment_in_form_of_curve, IN[1]=The_number_of_profiles_in_the_family, IN[2]=Bridge_segment_legnth)  # IronPython2
# ---------- python_script.python (39 lines) ----------
# Load the Python Standard and DesignScript Libraries
import sys
import clr
clr.AddReference('ProtoGeometry')
from Autodesk.DesignScript.Geometry import *

def chunks(lst, n):
    for i in range(0, len(lst), n-1):
        yield lst[i:i + n]

align = IN[0]
segments = IN[1]
length = IN[2]



pts1 = list(align.PointsAtSegmentLengthFromPoint(align.StartPoint,length))
pts1.insert(0,align.StartPoint)
pts2 = chunks(pts1,segments)
angle = []
pts3 = []


for i in pts2:
    if len(i) == segments:   
        temp = []
        for j in i:
            param = align.ParameterAtPoint(j)
            tang = align.TangentAtParameter(param)
            ang = Vector.AngleAboutAxis(Vector.YAxis(),tang,Vector.ZAxis())+90
            if ang > 180:
                temp.append(ang-180)
            else:
                temp.append(ang)
            
        angle.append(temp)       
        pts3.append(i)
 
OUT = pts3, angle
# ----------------------------------------
code_block = CodeBlock(x=python_script) { x[0]; }
Bridge_familiy = Input(Bridge_familiy: var[]..[])
byPoints = AdaptiveComponent.ByPoints(points=code_block, familyType=Bridge_familiy)
code_block_2 = CodeBlock { "rot_XY_C"; }
code_block_3 = CodeBlock(x=python_script) { x[1]; }
code_block_4 = CodeBlock { 2; }
getItemAtIndex = List.GetItemAtIndex(list=code_block_3@L2, index=code_block_4)
setParameterByName = Element.SetParameterByName(element=byPoints, parameterName=code_block_2, value=getItemAtIndex)
code_block_5 = CodeBlock { "rot_XY_B"; }
code_block_6 = CodeBlock { 1; }
getItemAtIndex_2 = List.GetItemAtIndex(list=code_block_3@L2, index=code_block_6)
setParameterByName_2 = Element.SetParameterByName(element=byPoints, parameterName=code_block_5, value=getItemAtIndex_2)
code_block_7 = CodeBlock { "rot_XY_A"; }
code_block_8 = CodeBlock { 0; }
getItemAtIndex_3 = List.GetItemAtIndex(list=code_block_3@L2, index=code_block_8)
setParameterByName_3 = Element.SetParameterByName(element=byPoints, parameterName=code_block_7, value=getItemAtIndex_3)
Bridge_body = Output(byPoints)
