# Dynamo custom node Bridge_body_split_by_grid.dyf (Dynamo 2.10.1.3976)
# category: Dynabridge

The_alignment_in_form_of_curve = Input(The_alignment_in_form_of_curve: var[]..[])
Select_Revit_Grid = Input(Select_Revit_Grid: var[]..[])
curve = Grid.Curve(grid=Select_Revit_Grid)
closestPointTo = Geometry.ClosestPointTo(geometry=The_alignment_in_form_of_curve, other=curve)
splitByPoints = Curve.SplitByPoints(curve=The_alignment_in_form_of_curve, points=closestPointTo)
Number_of_profiles_in_the_family = Input(Number_of_profiles_in_the_family: int = 3)
code_block = CodeBlock(n=Number_of_profiles_in_the_family) { 0..1..#n; }
pointAtParameter = Curve.PointAtParameter(curve=splitByPoints, param=code_block, lacing=CrossProduct)
python_script = Python(IN[0]=The_alignment_in_form_of_curve, IN[1]=pointAtParameter)  # IronPython2
# ---------- python_script.python (30 lines) ----------
# Load the Python Standard and DesignScript Libraries
import sys
import clr
clr.AddReference('ProtoGeometry')
from Autodesk.DesignScript.Geometry import *

align = IN[0]
pts1 = IN[1]


angle = []
pts2 = []


for i in pts1:

    temp = []
    for j in i:
        param = align.ParameterAtPoint(j)
        tang = align.TangentAtParameter(param)
        ang = Vector.AngleAboutAxis(Vector.YAxis(),tang,Vector.ZAxis())+90
        if ang > 180:
            temp.append(ang-180)
        else:
            temp.append(ang)
        
    angle.append(temp)       
    pts2.append(i)
 
OUT = pts2, angle
# ----------------------------------------
code_block_2 = CodeBlock(x=python_script) { x[0]; }
Bridge_family = Input(Bridge_family: var[]..[])
byPoints = AdaptiveComponent.ByPoints(points=code_block_2, familyType=Bridge_family)
code_block_3 = CodeBlock { "rot_XY_C"; }
code_block_4 = CodeBlock(x=python_script) { x[1]; }
code_block_5 = CodeBlock { 2; }
getItemAtIndex = List.GetItemAtIndex(list=code_block_4@L2, index=code_block_5)
setParameterByName = Element.SetParameterByName(element=byPoints, parameterName=code_block_3, value=getItemAtIndex)
code_block_6 = CodeBlock { "rot_XY_B"; }
code_block_7 = CodeBlock { 1; }
getItemAtIndex_2 = List.GetItemAtIndex(list=code_block_4@L2, index=code_block_7)
setParameterByName_2 = Element.SetParameterByName(element=byPoints, parameterName=code_block_6, value=getItemAtIndex_2)
code_block_8 = CodeBlock { "rot_XY_A"; }
code_block_9 = CodeBlock { 0; }
getItemAtIndex_3 = List.GetItemAtIndex(list=code_block_4@L2, index=code_block_9)
setParameterByName_3 = Element.SetParameterByName(element=byPoints, parameterName=code_block_8, value=getItemAtIndex_3)
Bridge_body = Output(byPoints)
