# Dynamo custom node Create Corridors.dyf (Dynamo 2.10.1.3976)
# category: Dynabridge

The_alignment_in_form_of_curve = Input(The_alignment_in_form_of_curve: var[]..[])
startPoint = Curve.StartPoint(curve=The_alignment_in_form_of_curve)
code_block = CodeBlock { 1; }
pointsAtSegmentLengthFromPoint = Curve.PointsAtSegmentLengthFromPoint(curve=The_alignment_in_form_of_curve, point=startPoint, segmentLength=code_block)
join = List.Join(list0=startPoint, list1=pointsAtSegmentLengthFromPoint)
parameterAtPoint = Curve.ParameterAtPoint(curve=The_alignment_in_form_of_curve, point=join)
tangentAtParameter = Curve.TangentAtParameter(curve=The_alignment_in_form_of_curve, param=parameterAtPoint)
ZAxis = Vector.ZAxis()
byOriginNormalXAxis = Plane.ByOriginNormalXAxis(origin=join, normal=tangentAtParameter, xAxis=ZAxis)
toCoordinateSystem = Plane.ToCoordinateSystem(plane=byOriginNormalXAxis)
Left_corridor_width_in_meters = Input(Left_corridor_width_in_meters: var[]..[])
code_block_2 = CodeBlock(x=Left_corridor_width_in_meters) { -x; }
byCartesianCoordinates = Point.ByCartesianCoordinates(cs=toCoordinateSystem, y=code_block_2)
byPoints = NurbsCurve.ByPoints(points=byCartesianCoordinates)
Left_corridor = Output(byPoints)
Right_cooridor_width_in_meters = Input(Right_cooridor_width_in_meters: var[]..[])
byCartesianCoordinates_2 = Point.ByCartesianCoordinates(cs=toCoordinateSystem, y=Right_cooridor_width_in_meters)
byPoints_2 = NurbsCurve.ByPoints(points=byCartesianCoordinates_2)
Right_corridor = Output(byPoints_2)
