# Dynamo custom node Multi pier bridge.dyf (Dynamo 2.10.1.3976)
# category: Dynabridge

Select_piers = Input(Select_piers: var[]..[])
code_block = CodeBlock { "rotation"; }
Bridge_body = Input(Bridge_body: var[]..[])
code_block_2 = CodeBlock(element=Bridge_body) { element; }
getLocation = Element.GetLocation(element=Select_piers)
locations = AdaptiveComponent.Locations(adaptiveComponent=code_block_2)
byPoints = NurbsCurve.ByPoints(points=locations)
distanceTo = Geometry.DistanceTo(geometry=getLocation, other=byPoints, lacing=CrossProduct)
minimumItem = List.MinimumItem(list=distanceTo)
allIndicesOf = List.AllIndicesOf(list=distanceTo@L2, item=minimumItem)
flatten = List.Flatten(list=allIndicesOf)
getItemAtIndex = List.GetItemAtIndex(list=code_block_2, index=flatten)
faces = Element.Faces(element=getItemAtIndex)
code_block_3 = CodeBlock { 0.5; }
normalAtParameter = Surface.NormalAtParameter(surface=faces, u=code_block_3, v=code_block_3)
pointAtParameter = Surface.PointAtParameter(surface=faces, u=code_block_3, v=code_block_3)
Z = Point.Z(point=pointAtParameter)
sortByKey = List.SortByKey(list=normalAtParameter@L2, keys=Z@L2)
firstItem = List.FirstItem(list=sortByKey.sortedList@L2)
ZAxis = Vector.ZAxis()
angleWithVector = Vector.AngleWithVector(vector=firstItem, otherVector=ZAxis)
code_block_4 = CodeBlock(x=angleWithVector) { 180-x; }
setParameterByName = Element.SetParameterByName(element=Select_piers, parameterName=code_block, value=code_block_4, lacing=Longest)
code_block_5 = CodeBlock { "H"; }
sortByKey_2 = List.SortByKey(list=pointAtParameter@L2, keys=Z@L2)
firstItem_2 = List.FirstItem(list=sortByKey_2.sortedList@L2)
distanceTo_2 = Geometry.DistanceTo(geometry=getLocation, other=firstItem_2)
code_block_6 = CodeBlock(x=distanceTo_2) { x-0.3; }
setParameterByName_2 = Element.SetParameterByName(element=Select_piers, parameterName=code_block_5, value=code_block_6, lacing=Longest)
code_block_7 = CodeBlock { "Height_A"; "Height_B"; "Height_C"; }
The_alignment_in_form_of_curve = Input(The_alignment_in_form_of_curve: var[]..[])
code_block_8 = CodeBlock(alignment=The_alignment_in_form_of_curve) { alignment; }
startPoint = Curve.StartPoint(curve=code_block_8)
code_block_9 = CodeBlock { 2; }
pointsAtSegmentLengthFromPoint = Curve.PointsAtSegmentLengthFromPoint(curve=code_block_8, point=startPoint, segmentLength=code_block_9)
join = List.Join(list0=startPoint, list1=pointsAtSegmentLengthFromPoint)
code_block_10 = CodeBlock { 0; }
python_script = Python(IN[0]=join, IN[1]=getLocation)  # IronPython2
# ---------- python_script.python (31 lines) ----------
# Load the Python Standard and DesignScript Libraries
import sys
import clr
clr.AddReference('ProtoGeometry')
from Autodesk.DesignScript.Geometry import *

pts = IN[0]
locations = IN[1]

dist = []
minimum = []
indices = []

for i in locations:
	temp1 = []
	for j in pts:
		temp1.append(i.DistanceTo(j))	
		min1 = min(temp1)
	dist.append(temp1)
	minimum.append(min1)

for i in dist:
	for j,k in enumerate(i):
		for l in minimum:
			if k == l:
				indices.append(j)


	
OUT = sorted(indices)
		
# ----------------------------------------
count = List.Count(list=join)
code_block_11 = CodeBlock(x=count) { x-1; }
join_2 = List.Join(list0=code_block_10, list1=python_script, list2=code_block_11)
restOfItems = List.RestOfItems(list=join_2)
code_block_12 = CodeBlock(x=join_2, y=restOfItems) { x..y; }
getItemAtIndex_2 = List.GetItemAtIndex(list=join, index=code_block_12)
Curvature_factor = Input(Curvature_factor: double = 1.2)
count_2 = List.Count(list=getItemAtIndex_2@L2)
code_block_13 = CodeBlock { 2; }
code_block_14 = CodeBlock(x=Curvature_factor, n=count_2, y=code_block_13) { (-x*Math.Cos(0..360..#n)-x)-y; }
translate = Geometry.Translate(geometry=getItemAtIndex_2, zTranslation=code_block_14)
flatten_2 = List.Flatten(list=translate)
byPoints_2 = NurbsCurve.ByPoints(points=flatten_2)
closestPointTo = Geometry.ClosestPointTo(geometry=byPoints_2, other=locations)
distanceTo_3 = Geometry.DistanceTo(geometry=locations, other=closestPointTo)
code_block_15 = CodeBlock { 0; 1; 2; }
getItemAtIndex_3 = List.GetItemAtIndex(list=distanceTo_3@L2, index=code_block_15.out2)
setParameterByName_3 = Element.SetParameterByName(element=code_block_2, parameterName=code_block_7.out2, value=getItemAtIndex_3, lacing=Longest)
getItemAtIndex_4 = List.GetItemAtIndex(list=distanceTo_3@L2, index=code_block_15.out1)
setParameterByName_4 = Element.SetParameterByName(element=code_block_2, parameterName=code_block_7.out1, value=getItemAtIndex_4, lacing=Longest)
getItemAtIndex_5 = List.GetItemAtIndex(list=distanceTo_3@L2, index=code_block_15.out0)
setParameterByName_5 = Element.SetParameterByName(element=code_block_2, parameterName=code_block_7.out0, value=getItemAtIndex_5, lacing=Longest)
Bridge_body_2 = Output(setParameterByName_5)  # "Bridge body"
