# Dynamo custom node Read Alignment From Excel.dyf (Dynamo 2.10.1.3976)
# category: Dynabridge
# Reads the coordinates from the excel sheet. Sheet name is needed

categories = Categories("OST_ProjectBasePoint")  # graph input
all_elements_of_category = ElementsOfCategory(Category=categories)
parameters = Element.Parameters(element=all_elements_of_category)
name = Parameter.Name(parameter=parameters)
flatten = List.Flatten(list=name)
sort = List.Sort(list=flatten)
code_block = CodeBlock { [7,4,5]; }
getItemAtIndex = List.GetItemAtIndex(list=sort, index=code_block)
excel = Input(excel: string = "the x,y,z coordinates of the alignment in form of 3 columns in excel file")
fromPath = FileObject(path=excel)  # "File.FromPath"
sheet = Input(sheet: string = "Excel Sheet Name")
code_block_2 = CodeBlock { false; }
importExcel = Data.ImportExcel(file=fromPath, sheetName=sheet, showExcel=code_block_2)
code_block_3 = CodeBlock { 0; 1; 2; }
getItemAtIndex_2 = List.GetItemAtIndex(list=importExcel@L2, index=code_block_3.out0)
firstItem = List.FirstItem(list=getItemAtIndex_2)
getItemAtIndex_3 = List.GetItemAtIndex(list=importExcel@L2, index=code_block_3.out1)
firstItem_2 = List.FirstItem(list=getItemAtIndex_3)
getItemAtIndex_4 = List.GetItemAtIndex(list=importExcel@L2, index=code_block_3.out2)
firstItem_3 = List.FirstItem(list=getItemAtIndex_4)
create = List.Create(item0=firstItem, item1=firstItem_2, item2=firstItem_3)
setParameterByName = Element.SetParameterByName(element=all_elements_of_category, parameterName=getItemAtIndex, value=create, lacing=Longest)
sub = getItemAtIndex_3 - firstItem_2
sub_2 = getItemAtIndex_2 - firstItem
sub_3 = getItemAtIndex_4 - firstItem_3
byCoordinates = Point.ByCoordinates(x=sub, y=sub_2, z=sub_3)
byPoints = NurbsCurve.ByPoints(points=byCoordinates)
The_alignment_in_form_of_curve = Output(byPoints)
