# Dynamo custom node Set Bridge's Parameter.dyf (Dynamo 2.10.1.3976)
# category: Dynabridge

Bridge_body = Input(Bridge_body: var[]..[])
concat = String.Concat()  # unwired: string0, string1
Parameter_name = Input(Parameter_name: var[]..[])
code_block = CodeBlock { 3; }
cycle = List.Cycle(list=Parameter_name, amount=code_block)
code_block_2 = CodeBlock { ["_A","_B","_C"]; }
combine = List.Combine(combineFunction=concat, list0=cycle, list1=code_block_2)
code_block_3 = CodeBlock(x=combine) { x[0]; x[1]; x[2]; }
Parameter_value = Input(Parameter_value: var[]..[])
setParameterByName = Element.SetParameterByName(element=Bridge_body, parameterName=code_block_3.out2, value=Parameter_value, lacing=Longest)
setParameterByName_2 = Element.SetParameterByName(element=Bridge_body, parameterName=code_block_3.out1, value=Parameter_value, lacing=Longest)
setParameterByName_3 = Element.SetParameterByName(element=Bridge_body, parameterName=code_block_3.out0, value=Parameter_value, lacing=Longest)
Bridge_body_2 = Output(setParameterByName_3)  # "Bridge body"
