# Dynamo custom node CAD Layer Overrides.dyf (Dynamo 2.6.1.8786)
# category: GeniusLoci.CAD Import
# Get the graphic overrides applied to the CAD link or import layers (Imported Categories) in the given view.

importInstance = Input(importInstance: var[]..[])  # ImportInstance or CADLinkType
view = Input(view: var[]..[] = Revit.Application.Document.Current.ActiveView)
python_script = Python(IN[0]=importInstance, IN[1]=view)
# ---------- python_script.python (43 lines) ----------
#Alban de Chasteigner 2020
#twitter : @geniusloci_bim
#geniusloci.bim@gmail.com

import clr
clr.AddReference('RevitAPI')
from Autodesk.Revit.DB import *
# Import DocumentManager and TransactionManager
clr.AddReference('RevitServices')
import RevitServices
from RevitServices.Persistence import DocumentManager
doc = DocumentManager.Instance.CurrentDBDocument

clr.AddReference('DSCoreNodes')
import DSCore
from DSCore import Color

elements = UnwrapElement(IN[0]) if isinstance(IN[0],list) else [UnwrapElement(IN[0])]
view = UnwrapElement(IN[1])

listName,listprwe,listprojRGB,listprPat,listtrans,listhalf, = [],[],[],[],[],[]

for element in elements:
	catSub = element.Category.SubCategories
	listtrans.append(view.GetElementOverrides(element.Id).Transparency)
	listhalf.append(view.GetCategoryOverrides(element.Category.Id).Halftone)
	for cat_cad in catSub:
		o = view.GetCategoryOverrides(cat_cad.Id)
		if o.ProjectionLineColor.IsValid or o.ProjectionLineWeight !=-1 or o.ProjectionLinePatternId != ElementId(-1) :
			projCol = o.ProjectionLineColor
			if projCol.IsValid:
				projrgb = DSCore.Color.ByARGB(255, projCol.Red, projCol.Green, projCol.Blue)
			else:
				projrgb = "No graphic override"
			listprojRGB.Add(projrgb)
			if o.ProjectionLineWeight !=-1:
				listprwe.append(o.ProjectionLineWeight)
			else:
				listprwe.append("No graphic override")
			listName.append(doc.GetElement(cat_cad.Id).Name)
			listprPat.append(doc.GetElement(o.ProjectionLinePatternId))

OUT=listName,listprwe,listprojRGB,listprPat,listtrans,listhalf
# ----------------------------------------
code_block = CodeBlock(x=python_script) { x[0]; x[1]; x[2]; x[3]; x[4]; x[5]; }
layerName = Output(code_block.out0)  # Only layers with override
ProjectionLineWeight = Output(code_block.out1)
ProjectionLineColor = Output(code_block.out2)
ProjectionLinePattern = Output(code_block.out3)
Transparency = Output(code_block.out4)
Halftone = Output(code_block.out5)
