# Dynamo custom node CAD Layer Visibility.dyf (Dynamo 2.6.1.8786)
# category: GeniusLoci.CAD Import
# Checks if the layers (Imported Categories) of the CAD link or import are set to be invisible (hidden) in the given view.

importInstance = Input(importInstance: var[]..[])  # ImportInstance or CADLinkType
view = Input(view: var[]..[] = Revit.Application.Document.Current.ActiveView)
python_script = Python(IN[0]=importInstance, IN[1]=view)
# ---------- python_script.python (35 lines) ----------
import clr
clr.AddReference('RevitAPI')
from Autodesk.Revit.DB import *

clr.AddReference("RevitNodes")
import Revit
clr.ImportExtensions(Revit.Elements)

clr.AddReference("RevitServices")
import RevitServices
from RevitServices.Persistence import DocumentManager
from RevitServices.Transactions import TransactionManager

doc = DocumentManager.Instance.CurrentDBDocument
linkInstances = UnwrapElement(IN[0]) if isinstance(IN[0],list) else [UnwrapElement(IN[0])]
linkInstances=linkInstances[0]
view =UnwrapElement(IN[1]) if isinstance(IN[1],list) else [UnwrapElement(IN[1])]
view=view[0]

def getstatus(view, import_instance):
	hidden,hiddenId,visible,visibleId = [],[],[],[]
	catSub = import_instance.Category.SubCategories
	for cat_cad in catSub:
		in_view = view.GetCategoryHidden(cat_cad.Id)
		if in_view:
			hidden.append(doc.GetElement(cat_cad.Id).Name)
			#hiddenId.append(cat_cad.Id)
		else:
			visible.append(doc.GetElement(cat_cad.Id).Name)
			#visibleId.append(cat_cad.Id)
	return hidden,visible

output=getstatus(view,linkInstances)

OUT = output
# ----------------------------------------
code_block = CodeBlock(x=python_script) { x[0]; x[1]; }
Hidden_Layer_Name = Output(code_block.out0)
Visible_Layer_Name = Output(code_block.out1)
