# Dynamo custom node FamilyDocument SetCategory.dyf (Dynamo 2.12.1.8246)
# category: GeniusLoci.Family
# Set the family document category.

familyDocument = Input(familyDocument: var[]..[] = null)  # Autodesk.Revit.DB.Document
Category = Input(Category: var[]..[])
setCategory = Python(IN[0]=familyDocument, IN[1]=Category)  # IronPython2
# ---------- setCategory.python (43 lines) ----------
#Alban de Chasteigner 2023
#twitter : @geniusloci_bim
#geniusloci.bim@gmail.com
#https://github.com/albandechasteigner/GeniusLociForDynamo

import clr
clr.AddReference('RevitAPI')
import Autodesk
from Autodesk.Revit.DB import *

clr.AddReference('RevitServices')
import RevitServices
from RevitServices.Persistence import DocumentManager
from RevitServices.Transactions import TransactionManager

clr.AddReference('RevitNodes')
import Revit
clr.ImportExtensions(Revit.Elements)

import System

def tolist(x):
    if hasattr(x,'__iter__'): return x
    else : return [x]
    
inputdocs = tolist(UnwrapElement(IN[0]))
cat = tolist(IN[1])[0]

TransactionManager.Instance.ForceCloseTransaction()
for inputdoc in inputdocs :
	if inputdoc == None and (DocumentManager.Instance.CurrentDBDocument).IsFamilyDocument :
		doc = DocumentManager.Instance.CurrentDBDocument
	else : doc = inputdoc
	
	if isinstance(cat, Revit.Elements.Category): id = cat.Id
	else: id = cat.Id.IntegerValue
	
	TransactionManager.Instance.EnsureInTransaction(doc)
	doc.OwnerFamily.FamilyCategoryId = ElementId(id)
	TransactionManager.Instance.TransactionTaskDone()

if inputdocs[0] == None : OUT = doc
else : OUT = inputdocs
# ----------------------------------------
familyDocument_2 = Output(setCategory)  # "familyDocument"
