# Dynamo custom node Get ViewRange.dyf (Dynamo 2.6.1.8786)
# category: GeniusLoci.View
# Get the view range of a plan view or a plan region.
# Returns the View Range Levels and the Offset values.

view = Input(view: var[]..[] = Revit.Application.Document.Current.ActiveView)
get_view_range = Python(IN[0]=view)
# ---------- get_view_range.python (65 lines) ----------
import clr
clr.AddReference('RevitAPI')
from Autodesk.Revit.DB import *

clr.AddReference('RevitServices')
import RevitServices
from RevitServices.Persistence import DocumentManager
uiapp = DocumentManager.Instance.CurrentUIApplication
app = uiapp.Application
version=int(app.VersionNumber)

def levelBelow(level):
	levels = sorted(FilteredElementCollector(doc).OfClass(Level),key=lambda x : x.Elevation,reverse= True)
	try: below = next(x for x in levels if x.Elevation < level.Elevation)
	except StopIteration : below = level
	return below

def levelAbove(level):
	levels = sorted(FilteredElementCollector(doc).OfClass(Level),key=lambda x : x.Elevation)
	try: above = next(x for x in levels if x.Elevation > level.Elevation)
	except StopIteration : above = level
	return above

def level(id):
	if id.IntegerValue == -1:
		id = 'Unlimited View Depth'
	elif id.IntegerValue == -2 :
		id = levelAbove(view.GenLevel)
	elif id.IntegerValue == -3:
		id = view.GenLevel
	elif id.IntegerValue == -4:
		id = levelBelow(view.GenLevel)
	elif id.IntegerValue > 0:
		id = doc.GetElement(id)
	return id

views = UnwrapElement(IN[0]) if isinstance(IN[0],list) else [UnwrapElement(IN[0])]

topLevel,top,cutLevel,cut,bottomLevel,bottom,depthLevel,depth,underlayLevel,underlay=[],[],[],[],[],[],[],[],[],[]

for view in views :
	doc = view.Document
	if version < 2021:
		UIunit = doc.GetUnits().GetFormatOptions(UnitType.UT_Length).DisplayUnits
	else:
		UIunit = doc.GetUnits().GetFormatOptions(SpecTypeId.Length).GetUnitTypeId()
	viewRange=view.GetViewRange()
	topLvl = view.GetViewRange().GetLevelId(PlanViewPlane.TopClipPlane)
	topLevel.append(level(topLvl))
	top.append(UnitUtils.ConvertFromInternalUnits((viewRange.GetOffset(PlanViewPlane.TopClipPlane)),UIunit))
	cutLvl = view.GetViewRange().GetLevelId(PlanViewPlane.CutPlane)
	cutLevel.append(level(cutLvl))
	cut.append(UnitUtils.ConvertFromInternalUnits((viewRange.GetOffset(PlanViewPlane.CutPlane)),UIunit))
	bottomLvl = view.GetViewRange().GetLevelId(PlanViewPlane.BottomClipPlane)
	bottomLevel.append(level(bottomLvl))
	bottom.append(UnitUtils.ConvertFromInternalUnits((viewRange.GetOffset(PlanViewPlane.BottomClipPlane)),UIunit))
	depthLvl = view.GetViewRange().GetLevelId(PlanViewPlane.ViewDepthPlane)
	depthLevel.append(level(depthLvl))
	depth.append(UnitUtils.ConvertFromInternalUnits((viewRange.GetOffset(PlanViewPlane.ViewDepthPlane)),UIunit))
	underlayLvl = view.GetViewRange().GetLevelId(PlanViewPlane.UnderlayBottom)
	underlayLevel.append(level(underlayLvl))
	underlay.append(UnitUtils.ConvertFromInternalUnits((viewRange.GetOffset(PlanViewPlane.UnderlayBottom)),UIunit))

if isinstance(IN[0], list): OUT = topLevel,top,cutLevel,cut,bottomLevel,bottom,depthLevel,depth,underlayLevel,underlay
else: OUT = topLevel[0],top[0],cutLevel[0],cut[0],bottomLevel[0],bottom[0],depthLevel[0],depth[0],underlayLevel[0],underlay[0]
# ----------------------------------------
code_block = CodeBlock(x=get_view_range) { x[0]; x[1]; x[2]; x[3]; x[4]; x[5]; x[6]; x[7]; x[8]; x[9]; }
Top_Level = Output(code_block.out0)
Top = Output(code_block.out1)
Cut_Level = Output(code_block.out2)
Cut_plane = Output(code_block.out3)
Bottom_Level = Output(code_block.out4)
Bottom = Output(code_block.out5)
Depth_Level = Output(code_block.out6)
View_Depth = Output(code_block.out7)
Underlay_Level = Output(code_block.out8)
Underlay_Bottom = Output(code_block.out9)
