# Dynamo custom node Material Set Glossiness.dyf (Dynamo 2.6.1.8786)
# category: GeniusLoci.Material
# Set the glossiness of the Appearance asset of the material. (Available only for the Generic schema)
# Please note : There must be a valid texture or no texture in the Appareance Asset otherwise an error will occur.

material = Input(material: var[]..[])
glossiness = Input(glossiness: double[]..[])  # As many values as materials Range between 0 to 100
python_script = Python(IN[0]=material, IN[1]=glossiness)
# ---------- python_script.python (36 lines) ----------
#Alban de Chasteigner 2020
#twitter : @geniusloci_bim
#geniusloci.bim@gmail.com

import clr
clr.AddReference('RevitAPI')
from Autodesk.Revit.DB import *

clr.AddReference('RevitServices')
import RevitServices
from RevitServices.Persistence import DocumentManager
from RevitServices.Transactions import TransactionManager
doc = DocumentManager.Instance.CurrentDBDocument

def toList(obj):
    if hasattr(obj, '__iter__'): return obj
    else: return [obj]
    
mats = toList(UnwrapElement(IN[0]))
values = toList(IN[1])

for mat, value in zip(mats, values):
	appearanceAssetId = mat.AppearanceAssetId
	assetElem = doc.GetElement(appearanceAssetId)
	TransactionManager.Instance.EnsureInTransaction(doc)
	with Visual.AppearanceAssetEditScope(assetElem.Document) as editScope:
		editableAsset = editScope.Start(assetElem.Id)
		if (editableAsset.FindByName("BaseSchema")).Value == "GenericSchema":
			glossiness = editableAsset.FindByName("generic_glossiness")
			if glossiness.IsValidValue(value/100):
				glossiness.Value = value/100
		editScope.Commit(True)
	TransactionManager.Instance.TransactionTaskDone()

if isinstance(IN[0], list): OUT = mats
else: OUT = mats[0]
# ----------------------------------------
Material = Output(python_script)
