# Dynamo custom node Set ViewRange.dyf (Dynamo 2.6.1.8786)
# category: GeniusLoci.View
# Set the view range of the given plan view.

view = Input(view: var[]..[] = Revit.Application.Document.Current.ActiveView)
TopLevel = Input(TopLevel: var[]..[] = null)  # Level
Top = Input(Top: double[]..[])
CutLevel = Input(CutLevel: var[]..[] = null)  # Level
CutPlane = Input(CutPlane: double[]..[])
BottomLevel = Input(BottomLevel: var[]..[] = null)  # Level
Bottom = Input(Bottom: double[]..[])
DepthLevel = Input(DepthLevel: var[]..[] = null)  # Level
ViewDepth = Input(ViewDepth: double[]..[])
set_view_range = Python(IN[0]=view, IN[1]=TopLevel, IN[2]=Top, IN[3]=CutLevel, IN[4]=CutPlane, IN[5]=BottomLevel, IN[6]=Bottom, IN[7]=DepthLevel, IN[8]=ViewDepth)
# ---------- set_view_range.python (68 lines) ----------
import clr
clr.AddReference('RevitAPI')
from Autodesk.Revit.DB import *
clr.AddReference('RevitServices')
from RevitServices.Persistence import DocumentManager
from RevitServices.Transactions import TransactionManager
doc = DocumentManager.Instance.CurrentDBDocument
uiapp = DocumentManager.Instance.CurrentUIApplication
app = uiapp.Application
version=int(app.VersionNumber)
if version < 2021:
	UIunit = doc.GetUnits().GetFormatOptions(UnitType.UT_Length).DisplayUnits
else:
	UIunit = doc.GetUnits().GetFormatOptions(SpecTypeId.Length).GetUnitTypeId()

def tolist(obj1):
	if hasattr(obj1,"__iter__"): return obj1
	else: return [obj1]

views = tolist(UnwrapElement(IN[0]))
topLs = tolist(UnwrapElement(IN[1]))
tops = tolist(IN[2])
cutLs = tolist(UnwrapElement(IN[3]))
cuts = tolist(IN[4])
botLs = tolist(UnwrapElement(IN[5]))
bots = tolist(IN[6])
depLs = tolist(UnwrapElement(IN[7]))
deps = tolist(IN[8])

TransactionManager.Instance.EnsureInTransaction(doc)
for v,topL,top,cutL,cut,botL,bot,depL,dep in zip(views,topLs,tops,cutLs,cuts,botLs,bots,depLs,deps):
	#setting the viewrange of the view
	viewrange = v.GetViewRange()
	#To set associated Level :
	#asslvl = v.GenLevel

	#Setting top clip plane of the viewrange
	if topL is None:
		viewrange.SetLevelId(PlanViewPlane.TopClipPlane,viewrange.Unlimited)
	else :
		viewrange.SetLevelId(PlanViewPlane.TopClipPlane,topL.Id)
	viewrange.SetOffset(PlanViewPlane.TopClipPlane,UnitUtils.ConvertToInternalUnits(top,UIunit))

	#setting offset of cut plane
	if cutL is None:
		viewrange.SetLevelId(PlanViewPlane.CutPlane,viewrange.Current)
	else:	
		viewrange.SetLevelId(PlanViewPlane.CutPlane,cutL.Id)
	viewrange.SetOffset(PlanViewPlane.CutPlane,UnitUtils.ConvertToInternalUnits(cut,UIunit))
	#Setting bottom clip plane of the viewrange
	if botL is None:
		viewrange.SetLevelId(PlanViewPlane.BottomClipPlane,viewrange.Unlimited)
	else:
		viewrange.SetLevelId(PlanViewPlane.BottomClipPlane,botL.Id)
	viewrange.SetOffset(PlanViewPlane.BottomClipPlane,UnitUtils.ConvertToInternalUnits(bot,UIunit))

	#Setting view depth plane of the viewrange
	if depL is None:
		viewrange.SetLevelId(PlanViewPlane.ViewDepthPlane,viewrange.Unlimited)
	else:
		viewrange.SetLevelId(PlanViewPlane.ViewDepthPlane,depL.Id)
	viewrange.SetOffset(PlanViewPlane.ViewDepthPlane,UnitUtils.ConvertToInternalUnits(dep,UIunit))

	#Applying the viewrange to the view
	v.SetViewRange(viewrange)
TransactionManager.Instance.TransactionTaskDone()

OUT = IN[0]
# ----------------------------------------
View = Output(set_view_range)
