# Dynamo custom node CeilingPlanView.ByLevelAndViewTemplate.dyf (Dynamo 2.12.0.5650)
# category: Modelical.Views.Create
# This node creates a new ceiling plan based on a level and a view template (selected by name).

level = Input(_level: Revit.Elements.Level[]..[])  # Selected levels.
tempNames = Input(_tempNames: string[]..[])  # Name of selected templates.
python_script = Python(IN[0]=level, IN[1]=tempNames)  # IronPython2
# ---------- python_script.python (65 lines) ----------
# This node has been made by Modelical
# www.modelical.com

import clr
clr.AddReference('ProtoGeometry')
from Autodesk.DesignScript.Geometry import *

# Import DocumentManager and TransactionManager
clr.AddReference("RevitServices")
import RevitServices
from RevitServices.Persistence import DocumentManager
from RevitServices.Transactions import TransactionManager

# Import RevitAPI
clr.AddReference("RevitAPI")
import Autodesk
from Autodesk.Revit.DB import *

doc = DocumentManager.Instance.CurrentDBDocument

def toList(input):
    """Return iterable if available, a list of 1 otherwise"""
    if hasattr(input, "__iter__") and not isinstance(input, basestring):
        return input
    else:
        return [input]

#The inputs to this node will be stored as a list in the IN variable.
levels = toList(UnwrapElement(IN[0]))
viewTempName = toList(IN[1])

templateList = []
collector = FilteredElementCollector(doc).OfClass(View)
for j in viewTempName:
	for i in collector:
		if i.IsTemplate == True and i.Name == j:
			templateList.append(i)
			
for viewType in FilteredElementCollector(doc).OfClass(ViewFamilyType).WhereElementIsElementType().ToElements():
	if viewType.ViewFamily == ViewFamily.CeilingPlan:
		CeilingPlanTypeId= viewType.Id			


TransactionManager.Instance.EnsureInTransaction(doc)




newViews=[]

for lev in levels:
	for temp in templateList:
		try:
			v=ViewPlan.Create(doc,CeilingPlanTypeId,lev.Id)
			v.Name = lev.Name+"_"+temp.Name
			v.ViewTemplateId = temp.Id
			newViews.append(v)
		except:
			info=lev.Name+"_"+temp.Name+" cannot be created"
			newViews.append(info)

TransactionManager.Instance.TransactionTaskDone()

#Assign your output to the OUT variable
OUT = newViews
# ----------------------------------------
New_views__views = Output(python_script)  # "/*New views.*/ _views"
