# Dynamo custom node Element.Delete.dyf (Dynamo 2.12.0.5650)
# category: Modelical.Elements.Actions
# This node deletes Revit elements of the active project file, using the element ID or the element itself.

elementsOrIDs = Input(_elementsOrIDs: var[]..[])  # Elements or IDs
python_script = Python(IN[0]=elementsOrIDs)  # IronPython2
# ---------- python_script.python (66 lines) ----------
# This node has been made by Modelical
# www.modelical.com

import clr
clr.AddReference("ProtoGeometry")
from Autodesk.DesignScript.Geometry import *

# This import let's us call / use Dynamo nodes from Python code
clr.AddReference("DSCoreNodes")
from DSCore import *
# General API and User Interface API DLL

clr.AddReference("RevitAPI")
from Autodesk.Revit.DB import *
from Autodesk.Revit.DB.Structure import *

clr.AddReference("RevitAPIUI")
from Autodesk.Revit.UI import *

clr.AddReference("RevitNodes")
import Revit
clr.ImportExtensions(Revit.GeometryConversion)
clr.ImportExtensions(Revit.Elements)
# This bit is needed to access revit documents (project and families) 
# and to use Transactions (when we need to WRITE data to the Revit database)
clr.AddReference("RevitServices")
import RevitServices
from RevitServices.Persistence import DocumentManager
from RevitServices.Transactions import TransactionManager

uidoc = DocumentManager.Instance.CurrentUIApplication
doc = DocumentManager.Instance.CurrentDBDocument
app = uidoc.Application

# To be able to import Python Standard Library modules, we need to locate them
import sys
sys.path.append(r"C:\Program Files (x86)\IronPython 2.7\Lib")
# Function Helpers

def toList(input):
    """Return iterable if available, a list of 1 otherwise"""
    if hasattr(input, "__iter__") and not isinstance(input, basestring):
        return input
    else:
        return [input]

# Logic starts here
elementsOrIDs = toList(UnwrapElement(IN[0]))

TransactionManager.Instance.EnsureInTransaction(doc)
count=0
for elem in elementsOrIDs:
	try:
		doc.Delete(ElementId(int(elem)))
		count+=1
	except:
		try:
			doc.Delete(elem.Id)
			count+=1
		except:
			None 
	

TransactionManager.Instance.TransactionTaskDone()
# Output
OUT = str(count) + " element/s have been deleted from Revit"
# ----------------------------------------
Number_of_deleted_elements__info = Output(python_script)  # "/*Number of deleted elements*/ _info"
