# Dynamo custom node Element.SelectInRevit.dyf (Dynamo 2.12.0.5650)
# category: Modelical.Elements.Actions
# This node allows to select Revit elements using the element ID or the element itself.

elementsOrIDs = Input(_elementsOrIDs: var[]..[])  # Elements or IDs
python_script = Python(IN[0]=elementsOrIDs)  # IronPython2
# ---------- python_script.python (76 lines) ----------
# This node has been made by Modelical
# www.modelical.com

import clr
clr.AddReference("ProtoGeometry")
from Autodesk.DesignScript.Geometry import *



clr.AddReference("RevitAPI")
from Autodesk.Revit.DB import *


clr.AddReference("RevitAPIUI")
from Autodesk.Revit.UI import *

clr.AddReference("RevitNodes")
import Revit
clr.ImportExtensions(Revit.GeometryConversion)
clr.ImportExtensions(Revit.Elements)


clr.AddReference("RevitServices")
import RevitServices
from RevitServices.Persistence import DocumentManager
from RevitServices.Transactions import TransactionManager
from System.Collections.Generic import *

uidoc = DocumentManager.Instance.CurrentUIApplication.ActiveUIDocument
doc = DocumentManager.Instance.CurrentDBDocument
app = uidoc.Application


import sys
sys.path.append(r"C:\Program Files (x86)\IronPython 2.7\Lib")

def Feet2m(value):
	return value * 0.3048

def toList(input):

    if hasattr(input, "__iter__") and not isinstance(input, basestring):
        return iter(input)
    else:
        return [input]
        
def flatten(x):
    result = []
    for el in x:
        if hasattr(el, "__iter__") and not isinstance(el, basestring):
            result.extend(flatten(el))
        else:
            result.append(el)
    return result

# Logic starts here

elementsOrIDs = toList(UnwrapElement(flatten(IN[0])))

elementIds = List[ElementId]()
fList=[]
for elem in elementsOrIDs:

	try: 
		int(elem)
		elementIds.Add(ElementId(int(elem)))
		fList.append(doc.GetElement(ElementId(int(elem))))
	except:
		elementIds.Add(elem.Id)
		fList.append(elem)
selection = uidoc.Selection.SetElementIds(elementIds)

# Transactions

# Output
OUT = fList
# ----------------------------------------
Selected_elements__elements = Output(python_script)  # "/*Selected elements*/ _elements"
