# Dynamo custom node MEP.ChangeFittingLevel.dyf (Dynamo 2.6.1.8786)
# category: Modelical.Elements.Actions
# This node allows to change the level of a pipe or a duct fitting, without modifying the position.

ductOrPipeFittings = Input(_ductOrPipeFittings: var[]..[])  # Can include ducts or pipes. Their reference level will change
selectedLevel = Input(_selectedLevel: Revit.Elements.Level[]..[])  # Selected level or levels.
python_script = Python(IN[0]=ductOrPipeFittings, IN[1]=selectedLevel)
# ---------- python_script.python (173 lines) ----------
# This node has been made by Modelical
# www.modelical.com

import clr
clr.AddReference("ProtoGeometry")
from Autodesk.DesignScript.Geometry import *

# This import let's us call / use Dynamo nodes from Python code
clr.AddReference("DSCoreNodes")
from DSCore import *
# General API and User Interface API DLL

clr.AddReference("RevitAPI")
from Autodesk.Revit.DB import *
from Autodesk.Revit.DB.Structure import *

clr.AddReference("RevitAPIUI")
from Autodesk.Revit.UI import *

clr.AddReference("RevitNodes")
import Revit
clr.ImportExtensions(Revit.GeometryConversion)
clr.ImportExtensions(Revit.Elements)

clr.AddReference("RevitServices")
import RevitServices
from RevitServices.Persistence import DocumentManager
from RevitServices.Transactions import TransactionManager

uidoc = DocumentManager.Instance.CurrentUIApplication
doc = DocumentManager.Instance.CurrentDBDocument
app = uidoc.Application


import sys
sys.path.append(r"C:\Program Files (x86)\IronPython 2.7\Lib")
# Function Helpers
def Feet2m(value):
	return value * 0.3048

def toList(input):
    """Return iterable if available, a list of 1 otherwise"""
    if hasattr(input, "__iter__") and not isinstance(input, basestring):
        return input
    else:
        return [input]

def flatten(x):
    result = []
    for el in x:
        if hasattr(el, "__iter__") and not isinstance(el, basestring):
            result.extend(flatten(el))
        else:
            result.append(el)
    return result
    
def toModelUnits(x):
	if app.VersionNumber >=2020:
		docLengthUnit = Document.GetUnits(doc).GetFormatOptions(UnitType.UT_Length).DisplayUnits
		return UnitUtils.Convert(x,DisplayUnitType.DUT_DECIMAL_FEET,docLengthUnit)
	elif app.VersionNumber <2020:
		docLengthUnit = Document.GetUnits(doc).GetFormatOptions(SpecTypeId.Length).GetUnitTypeId()
		return UnitUtils.Convert(x, docLengthUnit, UnitTypeId.FeetFractionalInches)
		
def toInternalUnits(x):
	if app.VersionNumber >=2020:
		docLengthUnit = Document.GetUnits(doc).GetFormatOptions(UnitType.UT_Length).DisplayUnits
		return UnitUtils.Convert(x,docLengthUnit,DisplayUnitType.DUT_DECIMAL_FEET)
	elif app.VersionNumber <2020:
		docLengthUnit = Document.GetUnits(doc).GetFormatOptions(SpecTypeId.Length).GetUnitTypeId()
		return UnitUtils.Convert(x,UnitTypeId.FeetFractionalInches. docLengthUnit)
# Logic starts here
elements = toList(UnwrapElement(IN[0]))
destinationLevels =toList(UnwrapElement(IN[1]))


# Transactions
TransactionManager.Instance.EnsureInTransaction(doc)

if int(app.VersionNumber) < 2020:
	if len(destinationLevels) == 1:
		for f in elements:
			if f.Category.Name == str(Revit.Elements.Category.ById(ElementId(BuiltInCategory.OST_DuctCurves).IntegerValue)) or f.Category.Name == str(Revit.Elements.Category.ById(ElementId(BuiltInCategory.OST_PipeCurves).IntegerValue)):
				startLevel =f.get_Parameter(BuiltInParameter.RBS_START_LEVEL_PARAM).Set(destinationLevels[0].Id)
			else:
				try:
					startLevelId = f.get_Parameter(BuiltInParameter.FAMILY_LEVEL_PARAM).AsElementId()
					startLevelElevation = doc.GetElement(startLevelId).Elevation
					startOffset = f.get_Parameter(BuiltInParameter.INSTANCE_FREE_HOST_OFFSET_PARAM).AsDouble()
					endLevelElevation = destinationLevels[0].Elevation
					endOffset = (startLevelElevation + startOffset) - endLevelElevation
					endLevelId = destinationLevels[0].Id
					
					f.get_Parameter(BuiltInParameter.INSTANCE_FREE_HOST_OFFSET_PARAM).Set(endOffset)
					f.get_Parameter(BuiltInParameter.FAMILY_LEVEL_PARAM).Set(endLevelId)
					f.ToDSType(True)
				except:
					None			
	elif len(destinationLevels) > 1:
		i = 0
		for f in elements:
			if f.Category.Name == str(Revit.Elements.Category.ById(ElementId(BuiltInCategory.OST_DuctCurves).IntegerValue)) or f.Category.Name == str(Revit.Elements.Category.ById(ElementId(BuiltInCategory.OST_PipeCurves).IntegerValue)):
			
				startLevel =f.get_Parameter(BuiltInParameter.RBS_START_LEVEL_PARAM).Set(destinationLevels[i].Id)
			else:
				try:
					startLevelId = f.get_Parameter(BuiltInParameter.FAMILY_LEVEL_PARAM).AsElementId()
					startLevelElevation = doc.GetElement(startLevelId).Elevation
					startOffset = f.get_Parameter(BuiltInParameter.INSTANCE_FREE_HOST_OFFSET_PARAM).AsDouble()
					endLevelElevation = destinationLevels[i].Elevation
					endOffset = (startLevelElevation + startOffset) - endLevelElevation
					endLevelId = destinationLevels[i].Id
					
					f.get_Parameter(BuiltInParameter.INSTANCE_FREE_HOST_OFFSET_PARAM).Set(endOffset)
					f.get_Parameter(BuiltInParameter.FAMILY_LEVEL_PARAM).Set(endLevelId)
					f.ToDSType(True)
				except:
					None
			i+=1

elif int(app.VersionNumber) >= 2020:
	if len(destinationLevels) == 1:

		for f in elements:
			if f.Category.Name == str(Revit.Elements.Category.ById(ElementId(BuiltInCategory.OST_DuctCurves).IntegerValue)) or f.Category.Name == str(Revit.Elements.Category.ById(ElementId(BuiltInCategory.OST_PipeCurves).IntegerValue)):
			
				startLevel =f.get_Parameter(BuiltInParameter.RBS_START_LEVEL_PARAM).Set(destinationLevels[0].Id)
			else:
				try:
					startLevelId = f.get_Parameter(BuiltInParameter.FAMILY_LEVEL_PARAM).AsElementId()
					startLevelElevation = doc.GetElement(startLevelId).Elevation
					startOffset = f.get_Parameter(BuiltInParameter.INSTANCE_ELEVATION_PARAM).AsDouble()
					endLevelElevation = destinationLevels[0].Elevation
					endOffset = (startLevelElevation + startOffset) - endLevelElevation
					endLevelId = destinationLevels[0].Id
					
					f.get_Parameter(BuiltInParameter.FAMILY_LEVEL_PARAM).Set(endLevelId)
					f.get_Parameter(BuiltInParameter.INSTANCE_ELEVATION_PARAM).Set(endOffset)
					f.ToDSType(True)
				except:
					None
									
	elif len(destinationLevels) > 1:
		i = 0
		for f in elements:
			
			if f.Category.Name == str(Revit.Elements.Category.ById(ElementId(BuiltInCategory.OST_DuctCurves).IntegerValue)) or f.Category.Name == str(Revit.Elements.Category.ById(ElementId(BuiltInCategory.OST_PipeCurves).IntegerValue)):
			
				startLevel =f.get_Parameter(BuiltInParameter.RBS_START_LEVEL_PARAM).Set(destinationLevels[i].Id)
				
			else:
				try:
					startLevelId = f.get_Parameter(BuiltInParameter.FAMILY_LEVEL_PARAM).AsElementId()
					test.append(startLevelId)
					
					startLevelElevation = doc.GetElement(startLevelId).Elevation
					startOffset = f.get_Parameter(BuiltInParameter.INSTANCE_FREE_HOST_OFFSET_PARAM).AsDouble()
					endLevelElevation = destinationLevels[i].Elevation
					endOffset = (startLevelElevation + startOffset) - endLevelElevation
					endLevelId = destinationLevels[i].Id
					
					f.get_Parameter(BuiltInParameter.FAMILY_LEVEL_PARAM).Set(endLevelId)
					f.get_Parameter(BuiltInParameter.INSTANCE_ELEVATION_PARAM).Set(endOffset)
					f.ToDSType(True)
				except:
					None
			i+=1
	

# Your code
TransactionManager.Instance.TransactionTaskDone()
# Output
OUT = elements
# ----------------------------------------
elements = Output(python_script)  # "_elements"
