# Dynamo custom node AdaptiveFamilytwoPointsbyCurve.dyf (Dynamo 2.2.1.5175)
# category: PracticalBIM.Revit.Elements.AdaptiveComponent
# Creates an adaptive family by a Line geometry

curves = Input(curves: Autodesk.DesignScript.Geometry.Curve[]..[])
flatten = List.Flatten(list=curves)
startPoint = Curve.StartPoint(curve=flatten)
endPoint = Curve.EndPoint(curve=flatten)
list_create = List.Create(item0=startPoint, item1=endPoint)
transpose = List.Transpose(lists=list_create)
familyType = Input(familyType: Revit.Elements.FamilyType)
byPoints = AdaptiveComponent.ByPoints(points=transpose, familyType=familyType)
AdaptiveComponent = Output(byPoints)  # "AdaptiveComponent[]..[]"
