# Dynamo custom node AdaptiveFamilytwoPointsbySurfaces.dyf (Dynamo 2.2.1.5175)
# category: PracticalBIM.Revit.Elements.AdaptiveComponent
# Creates an Adaptive Family by two points on the perimeter curves of a surface

surface = Input(surface: Autodesk.DesignScript.Geometry.Surface[])
perimeterCurves = Surface.PerimeterCurves(surface=surface)
flatten = List.Flatten(list=perimeterCurves)
startPoint = Curve.StartPoint(curve=flatten)
endPoint = Curve.EndPoint(curve=flatten)
list_create = List.Create(item0=startPoint, item1=endPoint)
transpose = List.Transpose(lists=list_create)
familyType = Input(familyType: Revit.Elements.FamilyType)
byPoints = AdaptiveComponent.ByPoints(points=transpose, familyType=familyType)
AdaptiveComponent = Output(byPoints)  # "AdaptiveComponent[]..[]"
