# Dynamo custom node AddOffsettoStartandEndvaluesofLists.dyf (Dynamo 2.3.0.5885)
# category: PracticalBIM.Lists
# Add an Offset to a List of Values at Start and End
# packages: PracticalBIM 2020.0.28

OffsetValue = Input(OffsetValue: double)
ListToModify = Input(ListToModify: int[]..[])
firstItem = List.FirstItem(list=ListToModify@L2)
code_block = CodeBlock(a=firstItem, b=OffsetValue) { a+b; }
restOfItems = List.RestOfItems(list=ListToModify@L2)
addItemToFront = List.AddItemToFront(item=code_block@L1, list=restOfItems@L2)
lastItem = List.LastItem(list=addItemToFront@L2)
code_block_2 = CodeBlock(a=OffsetValue, b=lastItem) { a+b; }
removeLast = Custom[RemoveLast](list=addItemToFront@L2)  # package PracticalBIM; Remove Last element of a List
addItemToEnd = List.AddItemToEnd(item=code_block_2@L1, list=removeLast@L2)
NewValues = Output(addItemToEnd)  # "NewValues:int"
