# Dynamo custom node AllElementsbyFamilyName.dyf (Dynamo 2.3.0.5885)
# category: PracticalBIM.Revit.Elements.Element
# Gets all Elements by Family Name

FamilyName = Input(FamilyName: string)
byName = Family.ByName(name=FamilyName)
types = Family.Types(family=byName)
all_elements_of_family_type = ElementsOfFamilyType(Family_Type=types)
flatten = List.Flatten(list=all_elements_of_family_type)
AllElements = Output(flatten)  # "AllElements:Element"
