# Dynamo custom node AllPointsofCurves.dyf (Dynamo 2.3.0.5885)
# category: PracticalBIM.Geometry.Curves
# Extracts all Points from a Series of Curves

curve = Input(curve: Autodesk.DesignScript.Geometry.Curve[])
startPoint = Curve.StartPoint(curve=curve)
endPoint = Curve.EndPoint(curve=curve)
lastItem = List.LastItem(list=endPoint)
join = List.Join(list0=startPoint, list1=lastItem)
points = Output(join)  # "points:Point"
