# Dynamo custom node BeamLinesbyPointsCollectionsXY.dyf (Dynamo 2.6.1.8786)
# category: PracticalBIM.ModelGeneration.Lines
# Creates Lines from a point list with at least two values
# packages: PracticalBIM 2020.0.28

PointList = Input(PointList: var[])
X = Point.X(point=PointList)
groupByKey = List.GroupByKey(list=PointList, keys=X)
sort = List.Sort(list=groupByKey.unique_keys)
indexOf = List.IndexOf(list=groupByKey.unique_keys, element=sort)
getItemAtIndex = List.GetItemAtIndex(list=groupByKey.groups, index=indexOf)
Y = Point.Y(point=getItemAtIndex)
sort_2 = List.Sort(list=Y@L2)
indexOf_2 = List.IndexOf(list=Y@L2, element=sort_2@L2)
getItemAtIndex_2 = List.GetItemAtIndex(list=getItemAtIndex@L2, index=indexOf_2@L2)
removeLast = Custom[RemoveLast](list=getItemAtIndex_2@L2)  # package PracticalBIM
restOfItems = List.RestOfItems(list=getItemAtIndex_2@L2)
byStartPointEndPoint = Line.ByStartPointEndPoint(startPoint=removeLast, endPoint=restOfItems)
XOrientation = Output(byStartPointEndPoint)  # "XOrientation:Line"
Y_2 = Point.Y(point=PointList)
groupByKey_2 = List.GroupByKey(list=PointList, keys=Y_2)
sort_3 = List.Sort(list=groupByKey_2.unique_keys)
indexOf_3 = List.IndexOf(list=groupByKey_2.unique_keys, element=sort_3)
getItemAtIndex_3 = List.GetItemAtIndex(list=groupByKey_2.groups, index=indexOf_3)
X_2 = Point.X(point=getItemAtIndex_3)
sort_4 = List.Sort(list=X_2@L2)
indexOf_4 = List.IndexOf(list=X_2@L2, element=sort_4@L2)
getItemAtIndex_4 = List.GetItemAtIndex(list=getItemAtIndex_3@L2, index=indexOf_4@L2)
removeLast_2 = Custom[RemoveLast](list=getItemAtIndex_4@L2)
restOfItems_2 = List.RestOfItems(list=getItemAtIndex_4@L2)
byStartPointEndPoint_2 = Line.ByStartPointEndPoint(startPoint=removeLast_2, endPoint=restOfItems_2)
YOrientation = Output(byStartPointEndPoint_2)  # "YOrientation:Line"
