# Dynamo custom node BoundingBoxCentroid.dyf (Dynamo 2.3.0.5885)
# category: PracticalBIM.Geometry.Abstract.BoundingBox
# Gives the Centroid of a Bounding Box

boundingBox = Input(boundingBox: Autodesk.DesignScript.Geometry.BoundingBox)
toCuboid = BoundingBox.ToCuboid(boundingBox=boundingBox)
centroid = Solid.Centroid(solid=toCuboid)
Point = Output(centroid)
