# Dynamo custom node ChangeColorsonFilledRegionType.dyf (Dynamo 2.2.1.5175)
# category: PracticalBIM.Revit.Elements.FilledRegion
# Change the Colors of a Filled Region Type

element = Input(element: Revit.Elements.Element[])
code_block = CodeBlock { "Background Pattern Color"; }
value = Input(value: double[])
setParameterByName = Element.SetParameterByName(element=element, parameterName=code_block, value=value)
code_block_2 = CodeBlock { "Foreground Pattern Color"; }
setParameterByName_2 = Element.SetParameterByName(element=element, parameterName=code_block_2, value=value)
Element = Output(setParameterByName_2)  # "Element[]"
