# Dynamo custom node ChangePointZValue.dyf (Dynamo 2.2.1.5175)
# category: PracticalBIM.Geometry.Points
# Changes the Point z Value

PointtoChange = Input(PointtoChange: Autodesk.DesignScript.Geometry.Point)
X = Point.X(point=PointtoChange)
Y = Point.Y(point=PointtoChange)
PointtogetZ = Input(PointtogetZ: Autodesk.DesignScript.Geometry.Point)
Z = Point.Z(point=PointtogetZ)
byCoordinates = Point.ByCoordinates(x=X, y=Y, z=Z)
NewPoint = Output(byCoordinates)  # "NewPoint:Point[]"
