# Dynamo custom node ChangePointZValueofaPointwithaLine.dyf (Dynamo 2.2.1.5175)
# category: PracticalBIM.Geometry.Points
# Changes the Point Z Value of a Point with a Line

point = Input(point: Autodesk.DesignScript.Geometry.Point[])
X = Point.X(point=point)
Y = Point.Y(point=point)
curve = Input(curve: Autodesk.DesignScript.Geometry.Curve)
startPoint = Curve.StartPoint(curve=curve)
Z = Point.Z(point=startPoint)
byCoordinates = Point.ByCoordinates(x=X, y=Y, z=Z)
Point = Output(byCoordinates)  # "Point[]"
