# Dynamo custom node CleanAdditionalPointsFromFormwork.dyf (Dynamo 2.2.1.5175)
# category: PracticalBIM.Geometry.Points
# Cleans aditional Points from Formwork

point = Input(point: Autodesk.DesignScript.Geometry.Point[]..[])
X = Point.X(point=point)
code_block = CodeBlock { 2; }
round = Math.Round(number=X, digits=code_block)
Y = Point.Y(point=point)
code_block_2 = CodeBlock { 2; }
round_2 = Math.Round(number=Y, digits=code_block_2)
code_block_3 = CodeBlock(a=round, b=round_2) { a+"_"+b; }
uniqueItems = List.UniqueItems(list=code_block_3@L2)
firstIndexOf = List.FirstIndexOf(list=code_block_3, item=uniqueItems)
getItemAtIndex = List.GetItemAtIndex(list=X@L2, index=firstIndexOf@L2)
getItemAtIndex_2 = List.GetItemAtIndex(list=Y@L2, index=firstIndexOf@L2)
Z = Point.Z(point=point)
minimumItem = List.MinimumItem(list=Z)
byCoordinates = Point.ByCoordinates(x=getItemAtIndex, y=getItemAtIndex_2, z=minimumItem)
code_block_4 = CodeBlock { 0; }
getItemAtIndex_3 = List.GetItemAtIndex(list=byCoordinates@L2, index=code_block_4)
code_block_5 = CodeBlock { 1; }
getItemAtIndex_4 = List.GetItemAtIndex(list=byCoordinates@L2, index=code_block_5)
maximumItem = List.MaximumItem(list=Z)
byCoordinates_2 = Point.ByCoordinates(x=getItemAtIndex, y=getItemAtIndex_2, z=maximumItem)
code_block_6 = CodeBlock { 1; }
getItemAtIndex_5 = List.GetItemAtIndex(list=byCoordinates_2@L2, index=code_block_6)
code_block_7 = CodeBlock { 0; }
getItemAtIndex_6 = List.GetItemAtIndex(list=byCoordinates_2@L2, index=code_block_7)
list_create = List.Create(item0=getItemAtIndex_3, item1=getItemAtIndex_4, item2=getItemAtIndex_5, item3=getItemAtIndex_6)
transpose = List.Transpose(lists=list_create)
FinalPoints = Output(transpose)  # "FinalPoints:Point[]..[]"
