# Dynamo custom node ClearNullsofRemainder.dyf (Dynamo 2.3.0.5885)
# category: PracticalBIM.GD.Splits
# Clears all Nulls of Remainder by another Remainder

previousremainders = Input(previousremainders: double[])
flatten = List.Flatten(list=previousremainders)
remainders = Input(remainders: double[])
flatten_2 = List.Flatten(list=remainders)
isNull = Object.IsNull(obj=flatten_2)
code_block = CodeBlock { true; }
allIndicesOf = List.AllIndicesOf(list=isNull, item=code_block)
getItemAtIndex = List.GetItemAtIndex(list=flatten, index=allIndicesOf)
code_block_2 = CodeBlock { false; }
allIndicesOf_2 = List.AllIndicesOf(list=isNull, item=code_block_2)
getItemAtIndex_2 = List.GetItemAtIndex(list=flatten_2, index=allIndicesOf_2)
join = List.Join(list0=getItemAtIndex, list1=getItemAtIndex_2)
join_2 = List.Join(list0=allIndicesOf, list1=allIndicesOf_2)
sort = List.Sort(list=join_2)
indexOf = List.IndexOf(list=join_2, element=sort)
getItemAtIndex_3 = List.GetItemAtIndex(list=join, index=indexOf)
finalremainders = Output(getItemAtIndex_3)  # "finalremainders:double"
