# Dynamo custom node ColortoString_.dyf (Dynamo 2.3.0.5885)
# category: PracticalBIM.Display.Transfer
# Get a Color Name that can be retrieve back

color = Input(color: DSCore.Color[])
red = Color.Red(color=color)
code_block = CodeBlock(a=red) { a/255; }
code_block_2 = CodeBlock { 2; }
round = Math.Round(number=code_block, digits=code_block_2)
string_from_object = FromObject(obj=round)
code_block_3 = CodeBlock { 0; }
code_block_4 = CodeBlock { 4; }
substring = String.Substring(str=string_from_object, startIndex=code_block_3, length=code_block_4)
green = Color.Green(color=color)
code_block_5 = CodeBlock(a=green) { a/255; }
round_2 = Math.Round(number=code_block_5, digits=code_block_2)
string_from_object_2 = FromObject(obj=round_2)
substring_2 = String.Substring(str=string_from_object_2, startIndex=code_block_3, length=code_block_4)
blue = Color.Blue(color=color)
code_block_6 = CodeBlock(a=blue) { a/255; }
round_3 = Math.Round(number=code_block_6, digits=code_block_2)
string_from_object_3 = FromObject(obj=round_3)
substring_3 = String.Substring(str=string_from_object_3, startIndex=code_block_3, length=code_block_4)
code_block_7 = CodeBlock(a=substring, b=substring_2, c=substring_3) { "Color_"+a+"_"+b+"_"+c; }
ColorName = Output(code_block_7)  # "ColorName[]"
