# Dynamo custom node ColumnLinesbyLineSeparationandStartLocation.dyf (Dynamo 2.2.1.5175)
# category: PracticalBIM.Revit.Elements.StructuralColumns
# Create Column Lines by Line Separation and Start Location

curve = Input(curve: Autodesk.DesignScript.Geometry.Curve[])
length = Curve.Length(curve=curve)
separation = Input(separation: double)
code_block = CodeBlock(a=length, separation=separation) { a/separation; }
round = Math.Round(number=code_block)
code_block_2 = CodeBlock(n=round) { 0..1..#n; }
code_block_3 = CodeBlock { 1; }
removeNItemsBeginEnd = Custom[RemoveNItemsBeginEnd](list=code_block_2, numbertoremove=code_block_3)  # Removes a Number of Items from the Begining and from End
pointAtParameter = Curve.PointAtParameter(curve=curve, param=removeNItemsBeginEnd)
X = Point.X(point=pointAtParameter)
Y = Point.Y(point=pointAtParameter)
StartHeigth = Input(StartHeigth: double)
byCoordinates = Point.ByCoordinates(x=X, y=Y, z=StartHeigth)
byStartPointEndPoint = Line.ByStartPointEndPoint(startPoint=byCoordinates, endPoint=pointAtParameter)
Line = Output(byStartPointEndPoint)  # "Line[]"
