# Dynamo custom node CombineList3TimesAllResults.dyf (Dynamo 2.3.0.5885)
# category: PracticalBIM.GD.Splits
# Combines a List 3 Times to Get All Results
# packages: PracticalBIM 2020.0.28

listofLengths = Input(listofLengths: double[])
string_from_object = FromObject(obj=listofLengths)
numberStringWIthOneDecimal = Custom[NumberStringWIthOneDecimal](str=string_from_object)  # package PracticalBIM; Creates a Number String WIth One Decimal
flatten = List.Flatten(list=numberStringWIthOneDecimal)
code_block = CodeBlock { "_"; }
add = numberStringWIthOneDecimal + code_block  # lacing=CrossProduct
add_2 = add + numberStringWIthOneDecimal  # lacing=CrossProduct
flatten_2 = List.Flatten(list=add_2)
flatten_3 = List.Flatten(list=flatten_2)
code_block_2 = CodeBlock(a=flatten_2) { a+"_"; }
add_3 = code_block_2 + numberStringWIthOneDecimal  # lacing=CrossProduct
flatten_4 = List.Flatten(list=add_3)
join = List.Join(list0=flatten, list1=flatten_3, list2=flatten_4)
flatten_5 = List.Flatten(list=listofLengths)
add_4 = listofLengths + listofLengths  # lacing=CrossProduct
flatten_6 = List.Flatten(list=add_4)
flatten_7 = List.Flatten(list=add_4)
add_5 = flatten_7 + listofLengths  # lacing=CrossProduct
flatten_8 = List.Flatten(list=add_5)
join_2 = List.Join(list0=flatten_5, list1=flatten_6, list2=flatten_8)
groupByKey = List.GroupByKey(list=join, keys=join_2)
code_block_3 = CodeBlock { 2; }
round = Math.Round(number=groupByKey.unique_keys, digits=code_block_3)
sort = List.Sort(list=round)
Lengths = Output(sort)  # "Lengths:double"
indexOf = List.IndexOf(list=round, element=sort)
getItemAtIndex = List.GetItemAtIndex(list=groupByKey.groups, index=indexOf)
string_from_object_2 = FromObject(obj=getItemAtIndex)
code_block_4 = CodeBlock { "_"; }
split = String.Split(str=string_from_object_2, separator0=code_block_4)
toNumber = String.ToNumber(str=split)
Elements = Output(toNumber)  # "Elements:double"
