# Dynamo custom node CombineList3TimesValues.dyf (Dynamo 2.5.0.7460)
# category: PracticalBIM.Math
# Combines a List 4 Times with Mayor Value at Begining

listofvalues = Input(listofvalues: double[])
ge = listofvalues >= listofvalues  # lacing=CrossProduct
code_block = CodeBlock { true; }
allIndicesOf = List.AllIndicesOf(list=ge@L2, item=code_block)
getItemAtIndex = List.GetItemAtIndex(list=listofvalues, index=allIndicesOf)
code_block_2 = CodeBlock(a=listofvalues, b=getItemAtIndex) { a+b; }
flatten = List.Flatten(list=code_block_2)
flatten_2 = List.Flatten(list=getItemAtIndex)
ge_2 = flatten_2 >= listofvalues  # lacing=CrossProduct
code_block_3 = CodeBlock { true; }
allIndicesOf_2 = List.AllIndicesOf(list=ge_2@L2, item=code_block_3)
getItemAtIndex_2 = List.GetItemAtIndex(list=listofvalues, index=allIndicesOf_2)
add = flatten + getItemAtIndex_2
flatten_3 = List.Flatten(list=add)
flatten_4 = List.Flatten(list=getItemAtIndex_2)
ge_3 = flatten_4 >= listofvalues  # lacing=CrossProduct
code_block_4 = CodeBlock { true; }
allIndicesOf_3 = List.AllIndicesOf(list=ge_3@L2, item=code_block_4)
getItemAtIndex_3 = List.GetItemAtIndex(list=listofvalues, index=allIndicesOf_3)
add_2 = flatten_3 + getItemAtIndex_3
flatten_5 = List.Flatten(list=add_2)
flatten_6 = List.Flatten(list=add)
flatten_7 = List.Flatten(list=flatten)
flatten_8 = List.Flatten(list=listofvalues)
join = List.Join(list0=flatten_5, list1=flatten_6, list2=flatten_7, list3=flatten_8)
uniqueItems = List.UniqueItems(list=join)
sort = List.Sort(list=uniqueItems)
allIndicesOf_4 = List.AllIndicesOf(list=join, item=sort)
lastItem = List.LastItem(list=allIndicesOf_4@L2)
getItemAtIndex_4 = List.GetItemAtIndex(list=join, index=lastItem)
values = Output(getItemAtIndex_4)  # "values:double[]"
code_block_5 = CodeBlock(a=listofvalues, b=getItemAtIndex) { a+"_"+b; }
flatten_9 = List.Flatten(list=code_block_5)
code_block_6 = CodeBlock(a=flatten_9) { a+"_"; }
add_3 = code_block_6 + getItemAtIndex_2
flatten_10 = List.Flatten(list=add_3)
code_block_7 = CodeBlock(a=flatten_10) { a+"_"; }
add_4 = code_block_7 + getItemAtIndex_3
flatten_11 = List.Flatten(list=add_4)
flatten_12 = List.Flatten(list=add_3)
flatten_13 = List.Flatten(list=flatten_9)
flatten_14 = List.Flatten(list=listofvalues)
join_2 = List.Join(list0=flatten_11, list1=flatten_12, list2=flatten_13, list3=flatten_14)
getItemAtIndex_5 = List.GetItemAtIndex(list=join_2, index=lastItem)
string_from_object = FromObject(obj=getItemAtIndex_5)
code_block_8 = CodeBlock { "_"; }
split = String.Split(str=string_from_object, separator0=code_block_8)
toNumber = String.ToNumber(str=split)
Items = Output(toNumber)  # "Items:double[]..[]"
