# Dynamo custom node CombineList4TimesAllResults.dyf (Dynamo 2.3.0.5885)
# category: PracticalBIM.GD.Splits
# Combines a List 4 Times to Deliver All Results

listofLengths = Input(listofLengths: double[])
string_from_object = FromObject(obj=listofLengths)
numberStringWIthOneDecimal = Custom[NumberStringWIthOneDecimal](str=string_from_object)  # Creates a Number String WIth One Decimal
flatten = List.Flatten(list=numberStringWIthOneDecimal)
code_block = CodeBlock { "_"; }
add = numberStringWIthOneDecimal + code_block  # lacing=CrossProduct
add_2 = add + numberStringWIthOneDecimal  # lacing=CrossProduct
flatten_2 = List.Flatten(list=add_2)
flatten_3 = List.Flatten(list=flatten_2)
code_block_2 = CodeBlock(a=flatten_2) { a+"_"; }
add_3 = code_block_2 + numberStringWIthOneDecimal  # lacing=CrossProduct
flatten_4 = List.Flatten(list=add_3)
flatten_5 = List.Flatten(list=add_3)
code_block_3 = CodeBlock(a=flatten_5) { a+"_"; }
add_4 = code_block_3 + numberStringWIthOneDecimal  # lacing=CrossProduct
flatten_6 = List.Flatten(list=add_4)
join = List.Join(list0=flatten, list1=flatten_3, list2=flatten_4, list3=flatten_6)
flatten_7 = List.Flatten(list=listofLengths)
add_5 = listofLengths + listofLengths  # lacing=CrossProduct
flatten_8 = List.Flatten(list=add_5)
flatten_9 = List.Flatten(list=add_5)
add_6 = flatten_9 + listofLengths  # lacing=CrossProduct
flatten_10 = List.Flatten(list=add_6)
flatten_11 = List.Flatten(list=add_6)
add_7 = flatten_11 + listofLengths  # lacing=CrossProduct
flatten_12 = List.Flatten(list=add_7)
join_2 = List.Join(list0=flatten_7, list1=flatten_8, list2=flatten_10, list3=flatten_12)
groupByKey = List.GroupByKey(list=join, keys=join_2)
sort = List.Sort(list=groupByKey.unique_keys)
Lengths = Output(sort)  # "Lengths:double"
indexOf = List.IndexOf(list=groupByKey.unique_keys, element=sort)
getItemAtIndex = List.GetItemAtIndex(list=groupByKey.unique_keys, index=indexOf)
string_from_object_2 = FromObject(obj=getItemAtIndex)
code_block_4 = CodeBlock { "_"; }
split = String.Split(str=string_from_object_2, separator0=code_block_4)
toNumber = String.ToNumber(str=split)
Elements = Output(toNumber)  # "Elements:double"
