# Dynamo custom node CombineList4Timesvalues.dyf (Dynamo 2.3.0.5885)
# category: PracticalBIM.Math
# Combines a List 4 Times With values from Larger to smaller

listofvalues = Input(listofvalues: double[])
ge = listofvalues >= listofvalues  # lacing=CrossProduct
code_block = CodeBlock { true; }
allIndicesOf = List.AllIndicesOf(list=ge@L2, item=code_block)
getItemAtIndex = List.GetItemAtIndex(list=listofvalues, index=allIndicesOf)
code_block_2 = CodeBlock(a=listofvalues, b=getItemAtIndex) { a+b; }
flatten = List.Flatten(list=code_block_2)
flatten_2 = List.Flatten(list=getItemAtIndex)
ge_2 = flatten_2 >= listofvalues  # lacing=CrossProduct
code_block_3 = CodeBlock { true; }
allIndicesOf_2 = List.AllIndicesOf(list=ge_2@L2, item=code_block_3)
getItemAtIndex_2 = List.GetItemAtIndex(list=listofvalues, index=allIndicesOf_2)
add = flatten + getItemAtIndex_2
flatten_3 = List.Flatten(list=add)
flatten_4 = List.Flatten(list=getItemAtIndex_2)
ge_3 = flatten_4 >= listofvalues  # lacing=CrossProduct
code_block_4 = CodeBlock { true; }
allIndicesOf_3 = List.AllIndicesOf(list=ge_3@L2, item=code_block_4)
getItemAtIndex_3 = List.GetItemAtIndex(list=listofvalues, index=allIndicesOf_3)
add_2 = flatten_3 + getItemAtIndex_3
flatten_5 = List.Flatten(list=add_2)
flatten_6 = List.Flatten(list=getItemAtIndex_3)
ge_4 = flatten_6 >= listofvalues  # lacing=CrossProduct
code_block_5 = CodeBlock { true; }
allIndicesOf_4 = List.AllIndicesOf(list=ge_4@L2, item=code_block_5)
getItemAtIndex_4 = List.GetItemAtIndex(list=listofvalues, index=allIndicesOf_4)
add_3 = flatten_5 + getItemAtIndex_4
flatten_7 = List.Flatten(list=add_3)
flatten_8 = List.Flatten(list=add_2)
flatten_9 = List.Flatten(list=add)
flatten_10 = List.Flatten(list=flatten)
flatten_11 = List.Flatten(list=listofvalues)
join = List.Join(list0=flatten_7, list1=flatten_8, list2=flatten_9, list3=flatten_10, list4=flatten_11)
uniqueItems = List.UniqueItems(list=join)
sort = List.Sort(list=uniqueItems)
allIndicesOf_5 = List.AllIndicesOf(list=join, item=sort)
lastItem = List.LastItem(list=allIndicesOf_5@L2)
getItemAtIndex_5 = List.GetItemAtIndex(list=join, index=lastItem)
values = Output(getItemAtIndex_5)  # "values:double[]"
code_block_6 = CodeBlock(a=listofvalues, b=getItemAtIndex) { a+"_"+b; }
flatten_12 = List.Flatten(list=code_block_6)
code_block_7 = CodeBlock(a=flatten_12) { a+"_"; }
add_4 = code_block_7 + getItemAtIndex_2
flatten_13 = List.Flatten(list=add_4)
code_block_8 = CodeBlock(a=flatten_13) { a+"_"; }
add_5 = code_block_8 + getItemAtIndex_3
flatten_14 = List.Flatten(list=add_5)
code_block_9 = CodeBlock(a=flatten_14) { a+"_"; }
add_6 = code_block_9 + getItemAtIndex_4
flatten_15 = List.Flatten(list=add_6)
flatten_16 = List.Flatten(list=add_5)
flatten_17 = List.Flatten(list=add_4)
flatten_18 = List.Flatten(list=flatten_12)
flatten_19 = List.Flatten(list=listofvalues)
join_2 = List.Join(list0=flatten_15, list1=flatten_16, list2=flatten_17, list3=flatten_18, list4=flatten_19)
getItemAtIndex_6 = List.GetItemAtIndex(list=join_2, index=lastItem)
string_from_object = FromObject(obj=getItemAtIndex_6)
code_block_10 = CodeBlock { "_"; }
split = String.Split(str=string_from_object, separator0=code_block_10)
toNumber = String.ToNumber(str=split)
Items = Output(toNumber)  # "Items:double[]..[]"
