# Dynamo custom node CombineList5TimesValues.dyf (Dynamo 2.6.1.8786)
# category: PracticalBIM.Math
# Combines a List of 5 Times of Values

flatten = List.Flatten()  # unwired: list
listofvalues = Input(listofvalues: double[])
ge = listofvalues >= listofvalues  # lacing=CrossProduct
code_block = CodeBlock { true; }
allIndicesOf = List.AllIndicesOf(list=ge@L2, item=code_block)
getItemAtIndex = List.GetItemAtIndex(list=listofvalues, index=allIndicesOf)
code_block_2 = CodeBlock(a=listofvalues, b=getItemAtIndex) { a+b; }
flatten_2 = List.Flatten(list=code_block_2)
flatten_3 = List.Flatten(list=getItemAtIndex)
ge_2 = flatten_3 >= listofvalues  # lacing=CrossProduct
code_block_3 = CodeBlock { true; }
allIndicesOf_2 = List.AllIndicesOf(list=ge_2@L2, item=code_block_3)
getItemAtIndex_2 = List.GetItemAtIndex(list=listofvalues, index=allIndicesOf_2)
add = flatten_2 + getItemAtIndex_2
flatten_4 = List.Flatten(list=add)
flatten_5 = List.Flatten(list=getItemAtIndex_2)
ge_3 = flatten_5 >= listofvalues  # lacing=CrossProduct
code_block_4 = CodeBlock { true; }
allIndicesOf_3 = List.AllIndicesOf(list=ge_3@L2, item=code_block_4)
getItemAtIndex_3 = List.GetItemAtIndex(list=listofvalues, index=allIndicesOf_3)
add_2 = flatten_4 + getItemAtIndex_3
flatten_6 = List.Flatten(list=add_2)
flatten_7 = List.Flatten(list=getItemAtIndex_3)
ge_4 = flatten_7 >= listofvalues  # lacing=CrossProduct
code_block_5 = CodeBlock { true; }
allIndicesOf_4 = List.AllIndicesOf(list=ge_4@L2, item=code_block_5)
getItemAtIndex_4 = List.GetItemAtIndex(list=listofvalues, index=allIndicesOf_4)
add_3 = flatten_6 + getItemAtIndex_4
flatten_8 = List.Flatten(list=add_3)
flatten_9 = List.Flatten(list=getItemAtIndex_4)
ge_5 = flatten_9 >= listofvalues  # lacing=CrossProduct
code_block_6 = CodeBlock { true; }
allIndicesOf_5 = List.AllIndicesOf(list=ge_5@L2, item=code_block_6)
getItemAtIndex_5 = List.GetItemAtIndex(list=listofvalues, index=allIndicesOf_5)
add_4 = flatten_8 + getItemAtIndex_5
flatten_10 = List.Flatten(list=add_4)
flatten_11 = List.Flatten(list=add_3)
flatten_12 = List.Flatten(list=add_2)
flatten_13 = List.Flatten(list=add)
flatten_14 = List.Flatten(list=flatten_2)
flatten_15 = List.Flatten(list=listofvalues)
join = List.Join(list0=flatten_10, list1=flatten_11, list2=flatten_12, list3=flatten_13, list4=flatten_14, list5=flatten_15)
uniqueItems = List.UniqueItems(list=join)
sort = List.Sort(list=uniqueItems)
allIndicesOf_6 = List.AllIndicesOf(list=join, item=sort)
lastItem = List.LastItem(list=allIndicesOf_6@L2)
getItemAtIndex_6 = List.GetItemAtIndex(list=join, index=lastItem)
values = Output(getItemAtIndex_6)
code_block_7 = CodeBlock(a=listofvalues, b=getItemAtIndex) { a+"_"+b; }
flatten_16 = List.Flatten(list=code_block_7)
code_block_8 = CodeBlock(a=flatten_16) { a+"_"; }
add_5 = code_block_8 + getItemAtIndex_2
flatten_17 = List.Flatten(list=add_5)
code_block_9 = CodeBlock(a=flatten_17) { a+"_"; }
add_6 = code_block_9 + getItemAtIndex_3
flatten_18 = List.Flatten(list=add_6)
code_block_10 = CodeBlock(a=flatten_18) { a+"_"; }
add_7 = code_block_10 + getItemAtIndex_4
flatten_19 = List.Flatten(list=add_7)
code_block_11 = CodeBlock(a=flatten_19) { a+"_"; }
add_8 = code_block_11 + getItemAtIndex_5
flatten_20 = List.Flatten(list=add_8)
flatten_21 = List.Flatten(list=add_7)
flatten_22 = List.Flatten(list=add_6)
flatten_23 = List.Flatten(list=add_5)
flatten_24 = List.Flatten(list=flatten_16)
flatten_25 = List.Flatten(list=listofvalues)
join_2 = List.Join(list0=flatten_20, list1=flatten_21, list2=flatten_22, list3=flatten_23, list4=flatten_24, list5=flatten_25)
getItemAtIndex_7 = List.GetItemAtIndex(list=join_2, index=lastItem)
string_from_object = FromObject(obj=getItemAtIndex_7)
code_block_12 = CodeBlock { "_"; }
split = String.Split(str=string_from_object, separator0=code_block_12)
toNumber = String.ToNumber(str=split)
items = Output(toNumber)
