# Dynamo custom node CombineListofValuesSetCombinationsandValue.dyf (Dynamo 2.5.0.7460)
# category: PracticalBIM.GD.Splits
# Combines a multiple list of Values to set combinations

listofvalues = Input(listofvalues: double[])
ge = listofvalues >= listofvalues  # lacing=CrossProduct
code_block = CodeBlock { true; }
allIndicesOf = List.AllIndicesOf(list=ge@L2, item=code_block)
getItemAtIndex = List.GetItemAtIndex(list=listofvalues, index=allIndicesOf)
code_block_2 = CodeBlock(a=listofvalues, b=getItemAtIndex) { a+b; }
flatten = List.Flatten(list=code_block_2)
join = List.Join(list0=flatten, list1=listofvalues)
uniqueItems = List.UniqueItems(list=join)
sort = List.Sort(list=uniqueItems)
allIndicesOf_2 = List.AllIndicesOf(list=join, item=sort)
lastItem = List.LastItem(list=allIndicesOf_2@L2)
getItemAtIndex_2 = List.GetItemAtIndex(list=join, index=lastItem)
values = Output(getItemAtIndex_2)  # "values:double[]"
code_block_3 = CodeBlock(a=listofvalues, b=getItemAtIndex) { a+"_"+b; }
flatten_2 = List.Flatten(list=code_block_3)
join_2 = List.Join(list0=flatten_2, list1=listofvalues)
getItemAtIndex_3 = List.GetItemAtIndex(list=join_2, index=lastItem)
string_from_object = FromObject(obj=getItemAtIndex_3)
code_block_4 = CodeBlock { "_"; }
split = String.Split(str=string_from_object, separator0=code_block_4)
toNumber = String.ToNumber(str=split)
Items = Output(toNumber)  # "Items:double[]..[]"
