# Dynamo custom node CoordinateSystembyPointandVectorOveraCurveforLinearFamilies.dyf (Dynamo 2.2.1.5175)
# category: PracticalBIM.Geometry.Abstract.CoordinateSystems
# Creates a Coordinate System on Everypoint with Vectors over a Curve

origin = Input(origin: Autodesk.DesignScript.Geometry.Point[])
vector = Input(vector: Autodesk.DesignScript.Geometry.Vector[])
X = Vector.X(vector=vector)
Y = Vector.Y(vector=vector)
byCoordinates = Vector.ByCoordinates(x=X, y=Y)
ZAxis = Vector.ZAxis()
code_block = CodeBlock { 90; }
rotate = Vector.Rotate(vector=byCoordinates, axis=ZAxis, degrees=code_block)
cross = Vector.Cross(vector=vector, cross=rotate)
byOriginVectors = CoordinateSystem.ByOriginVectors(origin=origin, xAxis=rotate, yAxis=cross, zAxis=vector)
CoordinateSystem = Output(byOriginVectors)  # "CoordinateSystem[]"
