# Dynamo custom node CoordinateSystemforoneloopbyPointandVectoroveracurveforlinearfamilies.dyf (Dynamo 2.2.1.5175)
# category: PracticalBIM.RoallerCoasters
# Creates Coordinate Systems by a Point and a vector over a Curve for Linear Families

origin = Input(origin: Autodesk.DesignScript.Geometry.Point[])
vector = Input(vector: Autodesk.DesignScript.Geometry.Vector[])
X = Vector.X(vector=vector)
Y = Vector.Y(vector=vector)
byCoordinates = Vector.ByCoordinates(x=X, y=Y)
ZAxis = Vector.ZAxis()
code_block = CodeBlock { 90; }
normalized = Vector.Normalized(vector=byCoordinates)
code_block_2 = CodeBlock { 1; }
shiftIndices = List.ShiftIndices(list=byCoordinates, amount=code_block_2)
normalized_2 = Vector.Normalized(vector=shiftIndices)
add = Vector.Add(vector=normalized, vectorToAdd=normalized_2)
length = Vector.Length(vector=add)
code_block_3 = CodeBlock { 1; }
removeNItemsBeginEnd = Custom[RemoveNItemsBeginEnd](list=length, numbertoremove=code_block_3)  # Removes a Number of Items from the Begining and from End
minimumItem = List.MinimumItem(list=removeNItemsBeginEnd)
indexOf = List.IndexOf(list=length, element=minimumItem)
indexOf_2 = List.IndexOf(list=removeNItemsBeginEnd, element=minimumItem)
removeItemAtIndex = List.RemoveItemAtIndex(list=removeNItemsBeginEnd, indices=indexOf_2)
minimumItem_2 = List.MinimumItem(list=removeItemAtIndex)
indexOf_3 = List.IndexOf(list=length, element=minimumItem_2)
join = List.Join(list0=indexOf, list1=indexOf_3)
sort = List.Sort(list=join)
code_block_4 = CodeBlock { 0; }
getItemAtIndex = List.GetItemAtIndex(list=sort, index=code_block_4)
code_block_5 = CodeBlock(a=getItemAtIndex) { a; }
ofRepeatedItem = List.OfRepeatedItem(item=code_block, amount=code_block_5)
code_block_6 = CodeBlock { -90; }
code_block_7 = CodeBlock { 1; }
getItemAtIndex_2 = List.GetItemAtIndex(list=sort, index=code_block_7)
code_block_8 = CodeBlock(a=getItemAtIndex_2, b=getItemAtIndex) { a-b; }
ofRepeatedItem_2 = List.OfRepeatedItem(item=code_block_6, amount=code_block_8)
count = List.Count(list=length)
code_block_9 = CodeBlock(a=count, b=getItemAtIndex_2) { a-b+1; }
ofRepeatedItem_3 = List.OfRepeatedItem(item=code_block, amount=code_block_9)
join_2 = List.Join(list0=ofRepeatedItem, list1=ofRepeatedItem_2, list2=ofRepeatedItem_3)
rotate = Vector.Rotate(vector=byCoordinates, axis=ZAxis, degrees=join_2)
cross = Vector.Cross(vector=vector, cross=rotate)
byOriginVectors = CoordinateSystem.ByOriginVectors(origin=origin, xAxis=rotate, yAxis=cross, zAxis=vector)
CoordinateSystem = Output(byOriginVectors)  # "CoordinateSystem[]"
