# Dynamo custom node CoordinateSystemfromSurfacesVerticalAndVector.dyf (Dynamo 2.2.1.5175)
# category: PracticalBIM.Geometry.Abstract.CoordinateSystems
# Create a Coordinate System from a surface with a vertical plane and a vector

BaseSurface = Input(BaseSurface: Autodesk.DesignScript.Geometry.Surface)
code_block = CodeBlock { 0.5; }
pointAtParameter = Surface.PointAtParameter(surface=BaseSurface, u=code_block, v=code_block)
Vector1 = Input(Vector1: Autodesk.DesignScript.Geometry.Vector)
ZAxis = Vector.ZAxis()
normalAtParameter = Surface.NormalAtParameter(surface=BaseSurface, u=code_block, v=code_block)
byOriginVectors = CoordinateSystem.ByOriginVectors(origin=pointAtParameter, xAxis=Vector1, yAxis=ZAxis, zAxis=normalAtParameter)
CoordinateSystem = Output(byOriginVectors)
