# Dynamo custom node CreateBoundaryfromLegendGridforFilledRegions.dyf (Dynamo 2.2.1.5175)
# category: PracticalBIM.Revit.View.Drafting
# Craetes Boundaries to Place Filled Regions on Legend Grid

points = Input(points: Autodesk.DesignScript.Geometry.Point[]..[])
restOfItems = List.RestOfItems(list=points@L2)
transpose = List.Transpose(lists=restOfItems)
restOfItems_2 = List.RestOfItems(list=transpose@L2)
byBestFitThroughPoints = Line.ByBestFitThroughPoints(bestFitPoints=restOfItems_2)
removeLast = Custom[RemoveLast](list=byBestFitThroughPoints)  # Remove Last element of a List
code_block = CodeBlock { -1; }
shiftIndices = List.ShiftIndices(list=byBestFitThroughPoints, amount=code_block)
removeLast_2 = Custom[RemoveLast](list=shiftIndices)
list_create = List.Create(item0=removeLast, item1=removeLast_2)
transpose_2 = List.Transpose(lists=list_create)
byLoft = Surface.ByLoft(crossSections=transpose_2)
perimeterCurves = Surface.PerimeterCurves(surface=byLoft)
Curve = Output(perimeterCurves)  # "Curve[]..[]"
