# Dynamo custom node CreateCableTraybyLineCableTrayandSize.dyf (Dynamo 2.2.1.5175)
# category: PracticalBIM.Revit.Elements.MEP.CableTray
# Creates a Cable Tray using a line a Cable Tray and Size Properties

CableTrayLine = Input(CableTrayLine: Autodesk.DesignScript.Geometry.Line[])
CableTrayElement = Input(CableTrayElement: Revit.Elements.Element)
code_block = CodeBlock { "Type"; }
getParameterValueByName = Element.GetParameterValueByName(element=CableTrayElement, parameterName=code_block)
code_block_2 = CodeBlock { "Reference Level"; }
getParameterValueByName_2 = Element.GetParameterValueByName(element=CableTrayElement, parameterName=code_block_2)
Width = Input(Width: double[])
Height = Input(Height: double[])
byLines = Custom[CableTray.ByLines](Lines=CableTrayLine, CableTrayType=getParameterValueByName, level=getParameterValueByName_2, Width=Width, Height=Height)  # Creates CableTray by Lines, CableTrayType, Level, Width and Height
CableTray = Output(byLines)  # "CableTray:Element[]"
