# Dynamo custom node CreateCableTraybyLineandCableTray.dyf (Dynamo 2.2.1.5175)
# category: PracticalBIM.Revit.Elements.MEP.CableTray
# Creates a Cable Tray using Lines and Cable Tray Element

CableTrayLine = Input(CableTrayLine: Autodesk.DesignScript.Geometry.Line[])
CableTrayElement = Input(CableTrayElement: Revit.Elements.Element)
code_block = CodeBlock { "Type"; }
getParameterValueByName = Element.GetParameterValueByName(element=CableTrayElement, parameterName=code_block)
code_block_2 = CodeBlock { "Reference Level"; }
getParameterValueByName_2 = Element.GetParameterValueByName(element=CableTrayElement, parameterName=code_block_2)
code_block_3 = CodeBlock { "Width"; }
getParameterValueByName_3 = Element.GetParameterValueByName(element=CableTrayElement, parameterName=code_block_3)
code_block_4 = CodeBlock { "Height"; }
getParameterValueByName_4 = Element.GetParameterValueByName(element=CableTrayElement, parameterName=code_block_4)
byLines = Custom[CableTray.ByLines](Lines=CableTrayLine, CableTrayType=getParameterValueByName, level=getParameterValueByName_2, Width=getParameterValueByName_3, Height=getParameterValueByName_4)  # Creates CableTray by Lines, CableTrayType, Level, Width and Height
CableTray = Output(byLines)  # "CableTray:Element[]"
