# Dynamo custom node CreateCategoryPrioritybyLists.dyf (Dynamo 2.2.1.5175)
# category: PracticalBIM.4dSimulation
# Creates a Category Priority by Lists of Elements

ListofCategoryPriority = Input(ListofCategoryPriority: var[])
ListofCategoryNames = Input(ListofCategoryNames: var[])
ListofElements = Input(ListofElements: Revit.Elements.Element[])
code_block = CodeBlock { "Category"; }
getParameterValueByName = Element.GetParameterValueByName(element=ListofElements, parameterName=code_block)
name = Category.Name(category=getParameterValueByName)
indexOf = List.IndexOf(list=ListofCategoryNames, element=name)
getItemAtIndex = List.GetItemAtIndex(list=ListofCategoryPriority, index=indexOf)
ValueofCategoryPriority = Output(getItemAtIndex)  # "ValueofCategoryPriority:string[]"
