# Dynamo custom node CreateConduitbyLineConduitandSize.dyf (Dynamo 2.2.1.5175)
# category: PracticalBIM.Revit.Elements.MEP.Conduit
# Creates Conduit Elements by a Line a Conduit and a Size

ConduitLines = Input(ConduitLines: Autodesk.DesignScript.Geometry.Line[])
ConduitElement = Input(ConduitElement: Revit.Elements.Element)
code_block = CodeBlock { "Type"; }
getParameterValueByName = Element.GetParameterValueByName(element=ConduitElement, parameterName=code_block)
code_block_2 = CodeBlock { "Reference Level"; }
getParameterValueByName_2 = Element.GetParameterValueByName(element=ConduitElement, parameterName=code_block_2)
Diameter = Input(Diameter: double[])
byLines = Custom[Conduit.ByLines](Lines=ConduitLines, ConduitType=getParameterValueByName, level=getParameterValueByName_2, Diameter=Diameter)  # Creates conduits by Line, ConduitType, Level and Diameter
Conduit = Output(byLines)  # "Conduit:Element[]"
