# Dynamo custom node CreateCurlFromPoints.dyf (Dynamo 2.2.1.5175)
# category: PracticalBIM.4dSimulation
# Creates a Curl Coordinate Systems and Points from a set of Points from a Line

listofpoints = Input(listofpoints: Autodesk.DesignScript.Geometry.Point[])
count = List.Count(list=listofpoints)
code_block = CodeBlock(a=count) { a/2; }
code_block_2 = CodeBlock { 0; }
round = Math.Round(number=code_block, digits=code_block_2)
code_block_3 = CodeBlock(a=round) { 0..a-1..1; }
getItemAtIndex = List.GetItemAtIndex(list=listofpoints, index=code_block_3)
getItemAtIndex_2 = List.GetItemAtIndex(list=listofpoints, index=round)
code_block_4 = CodeBlock(a=code_block) { a+2; }
getItemAtIndex_3 = List.GetItemAtIndex(list=listofpoints, index=code_block_4)
distanceTo = Geometry.DistanceTo(geometry=getItemAtIndex_3, other=getItemAtIndex_2)
byCoordinates = Vector.ByCoordinates(z=distanceTo)
translate = Geometry.Translate(geometry=getItemAtIndex_2, direction=byCoordinates)
byPoints = NurbsCurve.ByPoints(points=listofpoints)
getOrientationVectorsFromPointsandCurves = Custom[GetOrientationVectorsFromPointsandCurvesSE](curve=byPoints, points=listofpoints)  # Get all orientation vectors and Points from a Line from start to end
getItemAtIndex_4 = List.GetItemAtIndex(list=getOrientationVectorsFromPointsandCurves, index=round)
translate_2 = Geometry.Translate(geometry=translate, direction=getItemAtIndex_4, distance=distanceTo)
code_block_5 = CodeBlock(a=distanceTo) { a*2; }
byCoordinates_2 = Vector.ByCoordinates(z=code_block_5)
translate_3 = Geometry.Translate(geometry=getItemAtIndex_2, direction=byCoordinates_2)
byThreePoints = Arc.ByThreePoints(firstPoint=getItemAtIndex_2, secondPoint=translate_2, thirdPoint=translate_3)
code_block_6 = CodeBlock { 0..1..#6; }
pointAtParameter = Curve.PointAtParameter(curve=byThreePoints, param=code_block_6)
removeLast = Custom[RemoveLast](list=pointAtParameter)  # Remove Last element of a List
reverse = Vector.Reverse(vector=getItemAtIndex_4)
translate_4 = Geometry.Translate(geometry=translate, direction=reverse, distance=distanceTo)
byThreePoints_2 = Arc.ByThreePoints(firstPoint=translate_3, secondPoint=translate_4, thirdPoint=getItemAtIndex_2)
pointAtParameter_2 = Curve.PointAtParameter(curve=byThreePoints_2, param=code_block_6)
removeLast_2 = Custom[RemoveLast](list=pointAtParameter_2)
code_block_7 = CodeBlock(a=round, b=count) { a+1..b-1..1; }
getItemAtIndex_5 = List.GetItemAtIndex(list=listofpoints, index=code_block_7)
join = List.Join(list0=getItemAtIndex, list1=removeLast, list2=removeLast_2, list3=getItemAtIndex_5)
code_block_8 = CodeBlock { 4; }
cleanPointsbyCurvatureandSegmenthLength = Custom[CleanPointsbyCurvatureandSegmenthLength](points=join, segmenthDistance=code_block_8)  # Cleans a set of Points using a segmenth Length
getOrientationVectorsFromPointsandCurves_2 = Custom[GetOrientationVectorsFromPointsandCurvesSE](curve=cleanPointsbyCurvatureandSegmenthLength.NurbsCurve, points=cleanPointsbyCurvatureandSegmenthLength.Point)
coordinateSystemforoneloopbyPointandVect = Custom[CoordinateSystemforoneloopbyPointandVectoroveracurveforlinearfamilies](vector=getOrientationVectorsFromPointsandCurves_2, origin=cleanPointsbyCurvatureandSegmenthLength.Point)  # Creates Coordinate Systems by a Point and a vector over a Curve for Linear Families
distance = Input(distance: double)
count_2 = List.Count(list=coordinateSystemforoneloopbyPointandVect)
code_block_9 = CodeBlock(a=count_2) { a/4; }
code_block_10 = CodeBlock { 0; }
round_2 = Math.Round(number=code_block_9, digits=code_block_10)
chop = List.Chop(list=coordinateSystemforoneloopbyPointandVect, lengths=round_2)
count_3 = List.Count(list=chop@L2)
code_block_11 = CodeBlock { 0; }
getItemAtIndex_6 = List.GetItemAtIndex(list=count_3, index=code_block_11)
code_block_12 = CodeBlock(a=distance, b=getItemAtIndex_6) { 0..-a..#b; }
code_block_13 = CodeBlock { 1; }
getItemAtIndex_7 = List.GetItemAtIndex(list=count_3, index=code_block_13)
code_block_14 = CodeBlock(a=distance, b=getItemAtIndex_7) { -a..0..#b; }
code_block_15 = CodeBlock { 2; }
getItemAtIndex_8 = List.GetItemAtIndex(list=count_3, index=code_block_15)
code_block_16 = CodeBlock(b=getItemAtIndex_8) { 0..0..#b; }
code_block_17 = CodeBlock { 3; }
getItemAtIndex_9 = List.GetItemAtIndex(list=count_3, index=code_block_17)
code_block_18 = CodeBlock(b=getItemAtIndex_9) { 0..0..#b; }
join_2 = List.Join(list0=code_block_12, list1=code_block_14, list2=code_block_16, list3=code_block_18)
byCartesianCoordinates = Point.ByCartesianCoordinates(cs=coordinateSystemforoneloopbyPointandVect, x=join_2)
flatten = List.Flatten(list=byCartesianCoordinates)
code_block_19 = CodeBlock { 4; }
cleanPointsbyCurvatureandSegmenthLength_2 = Custom[CleanPointsbyCurvatureandSegmenthLength](points=flatten, segmenthDistance=code_block_19)
getOrientationVectorsFromPointsandCurves_3 = Custom[GetOrientationVectorsFromPointsandCurvesSE](curve=cleanPointsbyCurvatureandSegmenthLength_2.NurbsCurve, points=cleanPointsbyCurvatureandSegmenthLength_2.Point)
coordinateSystemforoneloopbyPointandVect_2 = Custom[CoordinateSystemforoneloopbyPointandVectoroveracurveforlinearfamilies](vector=getOrientationVectorsFromPointsandCurves_3, origin=cleanPointsbyCurvatureandSegmenthLength_2.Point)
byCartesianCoordinates_2 = Point.ByCartesianCoordinates(cs=coordinateSystemforoneloopbyPointandVect_2)
CurlPoints = Output(byCartesianCoordinates_2)  # "CurlPoints:Point[]"
CoordinateSystems = Output(coordinateSystemforoneloopbyPointandVect_2)  # "CoordinateSystems:CoordinateSystem[]"
