# Dynamo custom node CreateDuctbyLineDuctRectangularandSize.dyf (Dynamo 2.2.1.5175)
# category: PracticalBIM.Revit.Elements.MEP.Ducts
# Create a Duct Rectangular by Line Duct Type and Size

DuctLines = Input(DuctLines: Autodesk.DesignScript.Geometry.Curve[])
Ductelement = Input(Ductelement: Revit.Elements.Element)
code_block = CodeBlock { "Type"; }
getParameterValueByName = Element.GetParameterValueByName(element=Ductelement, parameterName=code_block)
code_block_2 = CodeBlock { "System Type"; }
getParameterValueByName_2 = Element.GetParameterValueByName(element=Ductelement, parameterName=code_block_2)
code_block_3 = CodeBlock { "Reference Level"; }
getParameterValueByName_3 = Element.GetParameterValueByName(element=Ductelement, parameterName=code_block_3)
Width = Input(Width: double[])
Height = Input(Height: double[])
byLines = Custom[DuctRectangular.ByLines](Lines=DuctLines, DuctType=getParameterValueByName, MechanicalSystemType=getParameterValueByName_2, level=getParameterValueByName_3, Width=Width, Height=Height)  # Create ducts by Lines, DuctType, MechanicalFittingType, Level, Width and Height
Ducts = Output(byLines)  # "Ducts:Element[]"
