# Dynamo custom node CreateDuctbyLineandDuctRectangular.dyf (Dynamo 2.2.1.5175)
# category: PracticalBIM.Revit.Elements.MEP.Ducts
# Creates a Duct from Lines and a Duct element properties Rectangular

DuctLines = Input(DuctLines: Autodesk.DesignScript.Geometry.Curve[])
Ductelement = Input(Ductelement: Revit.Elements.Element)
code_block = CodeBlock { "Type"; }
getParameterValueByName = Element.GetParameterValueByName(element=Ductelement, parameterName=code_block)
code_block_2 = CodeBlock { "System Type"; }
getParameterValueByName_2 = Element.GetParameterValueByName(element=Ductelement, parameterName=code_block_2)
code_block_3 = CodeBlock { "Reference Level"; }
getParameterValueByName_3 = Element.GetParameterValueByName(element=Ductelement, parameterName=code_block_3)
code_block_4 = CodeBlock { "Width"; }
getParameterValueByName_4 = Element.GetParameterValueByName(element=Ductelement, parameterName=code_block_4)
code_block_5 = CodeBlock { "Height"; }
getParameterValueByName_5 = Element.GetParameterValueByName(element=Ductelement, parameterName=code_block_5)
byLines = Custom[DuctRectangular.ByLines](Lines=DuctLines, DuctType=getParameterValueByName, MechanicalSystemType=getParameterValueByName_2, level=getParameterValueByName_3, Width=getParameterValueByName_4, Height=getParameterValueByName_5)  # Create ducts by Lines, DuctType, MechanicalFittingType, Level, Width and Height
Ducts = Output(byLines)  # "Ducts:Element[]"
