# Dynamo custom node CreateDuctbyLineandDuctRound.dyf (Dynamo 2.2.1.5175)
# category: PracticalBIM.Revit.Elements.MEP.Ducts
# Creates Rounded Ducts by a Line and a Duct Round

DuctLines = Input(DuctLines: Autodesk.DesignScript.Geometry.Curve[])
Ductelement = Input(Ductelement: Revit.Elements.Element)
code_block = CodeBlock { "Type"; }
getParameterValueByName = Element.GetParameterValueByName(element=Ductelement, parameterName=code_block)
code_block_2 = CodeBlock { "System Type"; }
getParameterValueByName_2 = Element.GetParameterValueByName(element=Ductelement, parameterName=code_block_2)
code_block_3 = CodeBlock { "Reference Level"; }
getParameterValueByName_3 = Element.GetParameterValueByName(element=Ductelement, parameterName=code_block_3)
code_block_4 = CodeBlock { "Diameter"; }
getParameterValueByName_4 = Element.GetParameterValueByName(element=Ductelement, parameterName=code_block_4)
byLines = Custom[DuctRound.ByLines](Lines=DuctLines, DuctType=getParameterValueByName, MechanicalSystemType=getParameterValueByName_2, level=getParameterValueByName_3, Diameter=getParameterValueByName_4)  # Create round Ducts by Lines, DuctType, SystemType, Level and Diameter
Ducts = Output(byLines)  # "Ducts:Element[]"
