# Dynamo custom node CreateFilterandManageNavisXMLbyValues.dyf (Dynamo 2.2.1.5175)
# category: PracticalBIM.ClashDetection
# Creates a Filtered set of Data by a Navis XML File

x = Input(x: double[])
y = Input(y: double[])
z = Input(z: double[])
code_block = CodeBlock(a=x, b=y, c=z) { a+"_"+b+"_"+c; }
uniqueItems = List.UniqueItems(list=code_block)
firstIndexOf = List.FirstIndexOf(list=code_block, item=uniqueItems)
getItemAtIndex = List.GetItemAtIndex(list=x, index=firstIndexOf)
getItemAtIndex_2 = List.GetItemAtIndex(list=y, index=firstIndexOf)
getItemAtIndex_3 = List.GetItemAtIndex(list=z, index=firstIndexOf)
gridlocation = Input(gridlocation: string[])
separateGridLocationValueFromXMLNaviswor = Custom[SeparateGridLocationValueFromXMLNavisworks](gridlocation=gridlocation)  # Separates the values of Grids and Levels from a Native export of Navisworks XML
getItemAtIndex_4 = List.GetItemAtIndex(list=separateGridLocationValueFromXMLNaviswor.gridA, index=firstIndexOf)
getItemAtIndex_5 = List.GetItemAtIndex(list=separateGridLocationValueFromXMLNaviswor.gridB, index=firstIndexOf)
getItemAtIndex_6 = List.GetItemAtIndex(list=separateGridLocationValueFromXMLNaviswor.level, index=firstIndexOf)
code_block_2 = CodeBlock { "_"; }
disciplinename = Input(disciplinename: var[])
filenameslist = Input(filenameslist: var[])
sourcefilelist = Input(sourcefilelist: var[])
allIndicesOf = List.AllIndicesOf(list=filenameslist, item=sourcefilelist)
flatten = List.Flatten(list=allIndicesOf)
getItemAtIndex_7 = List.GetItemAtIndex(list=disciplinename, index=flatten)
allIndicesOf_2 = List.AllIndicesOf(list=code_block, item=uniqueItems)
getItemAtIndex_8 = List.GetItemAtIndex(list=getItemAtIndex_7, index=allIndicesOf_2)
join = String.Join(separator=code_block_2, string0=getItemAtIndex_8)
flatten_2 = List.Flatten(list=join)
code_block_3 = CodeBlock { 0.4; }
idelement = Input(idelement: var[])
flatten_3 = List.Flatten(list=idelement)
count = List.Count(list=flatten_3)
cycle = List.Cycle(list=code_block_3, amount=count)
getItemAtIndex_9 = List.GetItemAtIndex(list=cycle, index=firstIndexOf)
list_create = List.Create(item0=getItemAtIndex, item1=getItemAtIndex_2, item2=getItemAtIndex_3, item3=getItemAtIndex_4, item4=getItemAtIndex_5, item5=getItemAtIndex_6, item6=flatten_2, item7=getItemAtIndex_9)
resultinglist = Output(list_create)  # "resultinglist:List[]..[]"
