# Dynamo custom node CreateFloorFormworkIsolinesbySDandBD.dyf (Dynamo 2.2.1.5175)
# category: PracticalBIM.Revit.Elements.Floor
# Creates Isolines for Formwork Structure by SD and BS

surface = Input(surface: Autodesk.DesignScript.Geometry.Surface[])
code_block = CodeBlock { 0; }
code_block_2 = CodeBlock { 0.5; }
getIsoline = Surface.GetIsoline(surface=surface, isoDirection=code_block, parameter=code_block_2)
length = Curve.Length(curve=getIsoline)
code_block_3 = CodeBlock { 1; }
code_block_4 = CodeBlock { 0.5; }
getIsoline_2 = Surface.GetIsoline(surface=surface, isoDirection=code_block_3, parameter=code_block_4)
length_2 = Curve.Length(curve=getIsoline_2)
gt = length > length_2
shortDirection = If(test=gt, true=code_block_3, false=code_block)
long_distance = If(test=gt, true=length, false=length_2)
sd = Input(sd: double)
code_block_5 = CodeBlock(a=long_distance, sd=sd) { a/sd; }
code_block_6 = CodeBlock { 0; }
round = Math.Round(number=code_block_5, digits=code_block_6)
code_block_7 = CodeBlock(a=round) { 0..1..#a; }
code_block_8 = CodeBlock { 1; }
removeNItemsBeginEnd = Custom[RemoveNItemsBeginEnd](list=code_block_7, numbertoremove=code_block_8)  # Removes a Number of Items from the Begining and from End
getIsoline_3 = Surface.GetIsoline(surface=surface, isoDirection=shortDirection, parameter=removeNItemsBeginEnd)
ShortCurves = Output(getIsoline_3)  # "ShortCurves:Curve[]"
longDirection = If(test=gt, true=code_block, false=code_block_3)
shortDistance = If(test=gt, true=length_2, false=length)
bd = Input(bd: double)
code_block_9 = CodeBlock(a=shortDistance, bd=bd) { a/bd; }
round_2 = Math.Round(number=code_block_9, digits=code_block_6)
code_block_10 = CodeBlock(a=round_2) { 0..1..#a; }
removeNItemsBeginEnd_2 = Custom[RemoveNItemsBeginEnd](list=code_block_10, numbertoremove=code_block_8)
getIsoline_4 = Surface.GetIsoline(surface=surface, isoDirection=longDirection, parameter=removeNItemsBeginEnd_2)
LongCurves = Output(getIsoline_4)  # "LongCurves:Curve[]"
