# Dynamo custom node CreateMechanicalCylindersbyHighandLocation.dyf (Dynamo 2.2.1.5175)
# category: PracticalBIM.Revit.Elements.SoilMechanics
# Creates Mechanical Cylinders by HIgh and Location

geometry = Input(geometry: Autodesk.DesignScript.Geometry.Geometry)
geometrytranslated = Input(geometrytranslated: Autodesk.DesignScript.Geometry.Geometry)
addItemToFront = List.AddItemToFront(item=geometry@L1, list=geometrytranslated@L2)
restOfItems = List.RestOfItems(list=addItemToFront@L2)
code_block = CodeBlock { 5; }
byPointsRadius = Cylinder.ByPointsRadius(startPoint=addItemToFront, endPoint=restOfItems, radius=code_block)
count = List.Count(list=byPointsRadius@L2)
code_block_2 = CodeBlock(a=count) { 0..1..#a; }
color_range = ColorRange(value=code_block_2)  # unwired: colors, indices
byGeometryColor = Modifiers.GeometryColor.ByGeometryColor(geometry=byPointsRadius, color=color_range)
Cylinders = Output(byPointsRadius)  # "Cylinders:Solid[]"
