# Dynamo custom node CreatePipebyLinePipeandSize.dyf (Dynamo 2.2.1.5175)
# category: PracticalBIM.Revit.Elements.MEP.Pipes
# Creates a Pipe by Lines Pipes and Specific Size

PipeLines = Input(PipeLines: Autodesk.DesignScript.Geometry.Line[])
PipeElement = Input(PipeElement: Revit.Elements.Element)
code_block = CodeBlock { "Type"; }
getParameterValueByName = Element.GetParameterValueByName(element=PipeElement, parameterName=code_block)
code_block_2 = CodeBlock { "System Type"; }
getParameterValueByName_2 = Element.GetParameterValueByName(element=PipeElement, parameterName=code_block_2)
code_block_3 = CodeBlock { "Reference Level"; }
getParameterValueByName_3 = Element.GetParameterValueByName(element=PipeElement, parameterName=code_block_3)
Diameter = Input(Diameter: double[])
byLines = Custom[Pipe.ByLines](Lines=PipeLines, PipeType=getParameterValueByName, SystemType=getParameterValueByName_2, level=getParameterValueByName_3, Diameter=Diameter)  # Creates a pipe by Line, PipeType, SystemType, Level and Diameter
Pipes = Output(byLines)  # "Pipes[]"
