# Dynamo custom node CreateRectangularRailsbylocationpointwidthheigthandcs.dyf (Dynamo 2.2.1.5175)
# category: PracticalBIM.RoallerCoasters
# Creates a Solid Rectangular Rail by using a location point a width a heigth and a coordinate system

cs = Input(cs: Autodesk.DesignScript.Geometry.CoordinateSystem[])
xvalue = Input(xvalue: double)
width = Input(width: double)
code_block = CodeBlock(a=width) { a/2; }
code_block_2 = CodeBlock(a=xvalue, b=code_block) { a+b; }
yvalue = Input(yvalue: double)
byCartesianCoordinates = Point.ByCartesianCoordinates(cs=cs, x=code_block_2, y=yvalue)
heigth = Input(heigth: double)
code_block_3 = CodeBlock(a=yvalue, b=heigth) { a+b; }
byCartesianCoordinates_2 = Point.ByCartesianCoordinates(cs=cs, x=code_block_2, y=code_block_3)
code_block_4 = CodeBlock(a=xvalue, b=code_block) { a-b; }
byCartesianCoordinates_3 = Point.ByCartesianCoordinates(cs=cs, x=code_block_4, y=code_block_3)
byCartesianCoordinates_4 = Point.ByCartesianCoordinates(cs=cs, x=code_block_4, y=yvalue)
list_create = List.Create(item0=byCartesianCoordinates, item1=byCartesianCoordinates_2, item2=byCartesianCoordinates_3, item3=byCartesianCoordinates_4)
transpose = List.Transpose(lists=list_create)
code_block_5 = CodeBlock { true; }
byPoints = PolyCurve.ByPoints(points=transpose, connectLastToFirst=code_block_5)
code_block_6 = CodeBlock { 1; }
shiftIndices = List.ShiftIndices(list=byPoints, amount=code_block_6)
code_block_7 = CodeBlock { 2; }
shiftIndices_2 = List.ShiftIndices(list=byPoints, amount=code_block_7)
list_create_2 = List.Create(item0=byPoints, item1=shiftIndices, item2=shiftIndices_2)
transpose_2 = List.Transpose(lists=list_create_2)
byLoft = Solid.ByLoft(crossSections=transpose_2)
code_block_8 = CodeBlock { 2; }
code_block_9 = CodeBlock { 0; }
dropEveryNthItem = List.DropEveryNthItem(list=byLoft, n=code_block_8, offset=code_block_9)
Solid = Output(dropEveryNthItem)  # "Solid[]"
