# Dynamo custom node CreateSecuenceConstructionFileForSimParts.dyf (Dynamo 2.2.1.5175)
# category: PracticalBIM.4dSimulation
# Creates a Secuence of Construction File From the Simulation Parts

SimulationPartsValue = Input(SimulationPartsValue: string[])
CategoryandLevelSecuence = Input(CategoryandLevelSecuence: var[])
groupByKey = List.GroupByKey(list=SimulationPartsValue, keys=CategoryandLevelSecuence)
task_name = List.Flatten(list=groupByKey.groups)
code_block = CodeBlock { "Construct"; }
StartDate = Input(StartDate: var[])
TotalDurationofTasks = Input(TotalDurationofTasks: double[])
count = List.Count(list=groupByKey.groups@L2)
code_block_2 = CodeBlock(a=TotalDurationofTasks, b=count) { a/b; }
ofRepeatedItem = List.OfRepeatedItem(item=code_block_2@L1, amount=count@L1)
code_block_3 = CodeBlock(a=count) { 0..a-1..1; }
code_block_4 = CodeBlock(a=code_block_3) { 0..a..1; }
getItemAtIndex = List.GetItemAtIndex(list=ofRepeatedItem@L2, index=code_block_4@L3)
sum = Math.Sum(values=getItemAtIndex)
create = TimeSpan.Create(days=sum)
startDateofSimulations = DateTime.AddTimeSpan(dateTime=StartDate, timeSpan=create)
create_2 = TimeSpan.Create(days=ofRepeatedItem)
endDateofSimulations = DateTime.AddTimeSpan(dateTime=startDateofSimulations, timeSpan=create_2)
flattentoNavisworkstime = Custom[FlattentoNavisworkstime](DateTimes=endDateofSimulations)  # Flatten DateTime to a Format for Navisworks
endDates = List.Flatten(list=flattentoNavisworkstime)
count_2 = List.Count(list=endDates)
ofRepeatedItem_2 = List.OfRepeatedItem(item=code_block, amount=count_2)
flattentoNavisworkstime_2 = Custom[FlattentoNavisworkstime](DateTimes=startDateofSimulations)
startDate = List.Flatten(list=flattentoNavisworkstime_2)
list_create = List.Create(item0=task_name, item1=ofRepeatedItem_2, item2=startDate, item3=endDates)
SecuencebyParts = Output(list_create)  # "SecuencebyParts:var[]"
