# Dynamo custom node CreateSecuenceConstructionFileFromSimulation.dyf (Dynamo 2.2.1.5175)
# category: PracticalBIM.4dSimulation
# Craetes a Secuence Construction File From Simulation Parameters

SimulationValues = Input(SimulationValues: string[])
groupByKey = List.GroupByKey(list=SimulationValues, keys=SimulationValues)
flatten = List.Flatten(list=groupByKey.unique_keys)
code_block = CodeBlock { "Construct"; }
count = List.Count(list=groupByKey.unique_keys)
ofRepeatedItem = List.OfRepeatedItem(item=code_block, amount=count)
StartDates = Input(StartDates: var[])
flattentoNavisworkstime = Custom[FlattentoNavisworkstime](DateTimes=StartDates)  # Flatten DateTime to a Format for Navisworks
TotalDurationofTasks = Input(TotalDurationofTasks: double[])
create = TimeSpan.Create(days=TotalDurationofTasks)
addTimeSpan = DateTime.AddTimeSpan(dateTime=StartDates, timeSpan=create)
flattentoNavisworkstime_2 = Custom[FlattentoNavisworkstime](DateTimes=addTimeSpan)
list_create = List.Create(item0=flatten, item1=ofRepeatedItem, item2=flattentoNavisworkstime, item3=flattentoNavisworkstime_2)
SecuencebySim = Output(list_create)  # "SecuencebySim:var[]"
