# Dynamo custom node CreateSecuenceofnumbersbydistancefromMiddle.dyf (Dynamo 2.2.1.5175)
# category: PracticalBIM.Geometry.Points
# Creates a Sequence of Numbers by a distance of separation and a middle point

separation = Input(separation: double)
code_block = CodeBlock(a=separation) { a/2; }
length = Input(length: double)
code_block_2 = CodeBlock(length=length, a=separation) { length/a; }
round = Math.Round(number=code_block_2)
code_block_3 = CodeBlock(a=separation, b=round) { a*b; }
code_block_4 = CodeBlock(a=length, b=code_block_3) { a-b; }
code_block_5 = CodeBlock(a=code_block_4) { a/2; }
code_block_6 = CodeBlock(a=code_block, b=code_block_5) { a+b; }
code_block_7 = CodeBlock(a=length, b=code_block_5) { a+b; }
code_block_8 = CodeBlock(a=code_block_6, b=code_block_7, c=separation) { a..b..c; }
resultinglist = Output(code_block_8)  # "resultinglist:double[]"
