# Dynamo custom node CreateSphereswithParameters.dyf (Dynamo 2.2.1.5175)
# category: PracticalBIM.ClashDetection
# Creates Spheres with Parameters

familyType = Input(familyType: Revit.Elements.FamilyType)
list = Input(list: var[]..[])
code_block = CodeBlock { 0; }
getItemAtIndex = List.GetItemAtIndex(list=list, index=code_block)
code_block_2 = CodeBlock { 1; }
getItemAtIndex_2 = List.GetItemAtIndex(list=list, index=code_block_2)
code_block_3 = CodeBlock { 2; }
getItemAtIndex_3 = List.GetItemAtIndex(list=list, index=code_block_3)
code_block_4 = CodeBlock { 5; }
getItemAtIndex_4 = List.GetItemAtIndex(list=list, index=code_block_4)
count = List.Count(list=getItemAtIndex_4)
code_block_5 = CodeBlock(b=count) { 0..#b..1; }
list_create = List.Create(item0=getItemAtIndex, item1=getItemAtIndex_2, item2=getItemAtIndex_3, item3=code_block_5)
code_block_6 = CodeBlock { 2; }
code_block_7 = CodeBlock { 0; }
code_block_8 = CodeBlock { 1; }
sortListofListsL3 = Custom[SortListofListsL3](seq=list_create, sortIndex1=code_block_6, sortIndex2=code_block_7, sortIndex3=code_block_8)  # Sort Three levels of Lists by index
code_block_9 = CodeBlock { 3; }
getItemAtIndex_5 = List.GetItemAtIndex(list=sortListofListsL3, index=code_block_9)
getItemAtIndex_6 = List.GetItemAtIndex(list=getItemAtIndex, index=getItemAtIndex_5)
getItemAtIndex_7 = List.GetItemAtIndex(list=getItemAtIndex_2, index=getItemAtIndex_5)
getItemAtIndex_8 = List.GetItemAtIndex(list=getItemAtIndex_3, index=getItemAtIndex_5)
byCoordinates = Point.ByCoordinates(x=getItemAtIndex_6, y=getItemAtIndex_7, z=getItemAtIndex_8)
byPoint = FamilyInstance.ByPoint(familyType=familyType, point=byCoordinates)
code_block_10 = CodeBlock { "Grid A"; }
code_block_11 = CodeBlock { 3; }
getItemAtIndex_9 = List.GetItemAtIndex(list=list, index=code_block_11)
getItemAtIndex_10 = List.GetItemAtIndex(list=getItemAtIndex_9, index=getItemAtIndex_5)
setParameterByName = Element.SetParameterByName(element=byPoint, parameterName=code_block_10, value=getItemAtIndex_10)
code_block_12 = CodeBlock { "Grid B"; }
code_block_13 = CodeBlock { 4; }
getItemAtIndex_11 = List.GetItemAtIndex(list=list, index=code_block_13)
getItemAtIndex_12 = List.GetItemAtIndex(list=getItemAtIndex_11, index=getItemAtIndex_5)
string_from_object = FromObject(obj=getItemAtIndex_12)
setParameterByName_2 = Element.SetParameterByName(element=setParameterByName, parameterName=code_block_12, value=string_from_object)
code_block_14 = CodeBlock { "LevelC"; }
getItemAtIndex_13 = List.GetItemAtIndex(list=getItemAtIndex_4, index=getItemAtIndex_5)
string_from_object_2 = FromObject(obj=getItemAtIndex_13)
setParameterByName_3 = Element.SetParameterByName(element=setParameterByName_2, parameterName=code_block_14, value=string_from_object_2)
code_block_15 = CodeBlock { "Group"; }
code_block_16 = CodeBlock { 6; }
getItemAtIndex_14 = List.GetItemAtIndex(list=list, index=code_block_16)
getItemAtIndex_15 = List.GetItemAtIndex(list=getItemAtIndex_14, index=getItemAtIndex_5)
setParameterByName_4 = Element.SetParameterByName(element=setParameterByName_3, parameterName=code_block_15, value=getItemAtIndex_15)
code_block_17 = CodeBlock { "ID"; }
code_block_18 = CodeBlock(b=count) { 1..#b..1; }
string_from_object_3 = FromObject(obj=code_block_18)
setParameterByName_5 = Element.SetParameterByName(element=setParameterByName_4, parameterName=code_block_17, value=string_from_object_3)
code_block_19 = CodeBlock { "Radius"; }
code_block_20 = CodeBlock { 7; }
getItemAtIndex_16 = List.GetItemAtIndex(list=list, index=code_block_20)
getItemAtIndex_17 = List.GetItemAtIndex(list=getItemAtIndex_16, index=getItemAtIndex_5)
setParameterByName_6 = Element.SetParameterByName(element=setParameterByName_5, parameterName=code_block_19, value=getItemAtIndex_17)
Element = Output(setParameterByName_6)
