# Dynamo custom node CuboidbyMinandMaxofPointValues.dyf (Dynamo 2.2.1.5175)
# category: PracticalBIM.Geometry.Solids
# Creates a Cuboid by Minimun and Maximum values with XYZ and aditional values

PointXValue = Input(PointXValue: double[])
minimumItem = List.MinimumItem(list=PointXValue)
PointYvalue = Input(PointYvalue: double[])
minimumItem_2 = List.MinimumItem(list=PointYvalue)
PointZValue = Input(PointZValue: double[])
minimumItem_3 = List.MinimumItem(list=PointZValue)
AdditionalLowerValue = Input(AdditionalLowerValue: double)
code_block = CodeBlock(a=minimumItem_3, b=AdditionalLowerValue) { a-b; }
byCoordinates = Point.ByCoordinates(x=minimumItem, y=minimumItem_2, z=code_block)
maximumItem = List.MaximumItem(list=PointXValue)
maximumItem_2 = List.MaximumItem(list=PointYvalue)
maximumItem_3 = List.MaximumItem(list=PointZValue)
AdditionalUpperValue = Input(AdditionalUpperValue: double)
code_block_2 = CodeBlock(a=maximumItem_3, b=AdditionalUpperValue) { a+b; }
byCoordinates_2 = Point.ByCoordinates(x=maximumItem, y=maximumItem_2, z=code_block_2)
byCorners = Cuboid.ByCorners(lowPoint=byCoordinates, highPoint=byCoordinates_2)
ResultingCuboid = Output(byCorners)  # "ResultingCuboid:Cuboid"
