# Dynamo custom node DiamondGridBySurface.dyf (Dynamo 2.2.1.5175)
# category: PracticalBIM.Geometry.Paneling
# Creates a Diamond Grid By Surface

selectedsurface = Input(selectedsurface: Autodesk.DesignScript.Geometry.Surface)
U = Input(U: var[]..[])
listMatcher = Custom[ListMatcher](ListA=selectedsurface, ListB=U)  # Creates a matches between lists
V = Input(V: var[]..[])
listMatcher_2 = Custom[ListMatcher](ListA=selectedsurface, ListB=V)
python_script = Python(IN[0]=listMatcher.ListA, IN[1]=listMatcher.MatchListB, IN[2]=listMatcher_2.MatchListB)
# ---------- python_script.python (95 lines) ----------
#Copyright(c) 2014, Nathan Miller
# The Proving Ground, http://theprovingground.org

import clr
clr.AddReference('ProtoGeometry')
from Autodesk.DesignScript.Geometry import *

# Panel division class
class PanelDivision:
	
	# divide surface
	def DiamondDivision(self, srf, udiv, vdiv):
		ustep = 1.0/udiv
		vstep = 1.0/vdiv
		
		quads = []
		polys = []
		panels = []
		for i in range(0,int(udiv+1)):
			for j in range(0,int(vdiv+1)):
				if (i+j)%2 == 0:
					ptA = srf.PointAtParameter(0,0)
					ptB = srf.PointAtParameter(0,0)
					ptC = srf.PointAtParameter(0,0)
					ptD = srf.PointAtParameter(0,0)
			
					if i>0:
						ptA = srf.PointAtParameter((i-1)*ustep,j*vstep)
					else:
						ptB = srf.PointAtParameter(i*ustep,j*vstep)
				
					if j>0:
						ptB = srf.PointAtParameter(i*ustep,(j-1)*vstep)
					else:
						ptB = srf.PointAtParameter(i*ustep,j*vstep)
					
					if i<udiv:
						ptC = srf.PointAtParameter((i+1)*ustep,j*vstep)
					else:
						ptC = srf.PointAtParameter(i*ustep,j*vstep)
				
					if j<=(vdiv -1):
						ptD = srf.PointAtParameter(i*ustep,(j+1)*vstep)
					else:
						ptD = srf.PointAtParameter(i*ustep,j*vstep)
					
					if i>0 and j>0 and i<udiv and j<=(vdiv-1):
						quad = []
						#Append to quad
						quad.append(ptA)
						quad.append(ptB)
						quad.append(ptC)
						quad.append(ptD)
						#Append quads
						quads.append(quad)
					
						#polygons
						poly = Polygon.ByPoints(quad)
						polys.append(poly)
			
						#panels
						panel = Surface.ByPerimeterPoints(quad)
						panels.append(panel)
		self.quads = quads
		self.polys = polys
		self.panels = panels

#Main code
srf = IN[0]
udiv = IN[1]
vdiv = IN[2]

quads = []
polys = []
panels = []

for k in range(0, len(srf)):
	s = srf[k]
	u = udiv[k]
	v = vdiv[k]
			
	divide = PanelDivision()
	divide.DiamondDivision(s,u,v)
					
	quads.append(divide.quads)
	panels.append(divide.panels)
	polys.append(divide.polys)
		
output = []
output.append(quads)
output.append(polys)
output.append(panels)

#Assign your output to the OUT variable
OUT = output
# ----------------------------------------
number = DoubleInput(0)
getItemAtIndex = List.GetItemAtIndex(list=python_script, index=number)
A_Panel_Pts = Output(getItemAtIndex)  # "A-Panel Pts"
python_script_2 = Python(IN[0]=listMatcher.ListA, IN[1]=listMatcher.MatchListB, IN[2]=listMatcher_2.MatchListB)
# ---------- python_script_2.python (217 lines) ----------
# Nathan Miller, 2013
# The Proving Ground, http://theprovingground.org

import clr
clr.AddReference('ProtoGeometry')
from Autodesk.DesignScript.Geometry import *


# Panel division class
class PanelDivision:
	
	# divide surface
	def DiamondEdgeDivision(self, srf, udiv, vdiv):
		ustep = 1.0/udiv
		vstep = 1.0/vdiv
		
		quads = []
		polys = []
		panels = []
		for i in range(0,int(udiv+1)):
			for j in range(0,int(vdiv+1)):
				if (i+j)%2 == 0:
					ptA = srf.PointAtParameter(0,0)
					ptB = srf.PointAtParameter(0,0)
					ptC = srf.PointAtParameter(0,0)
					ptD = srf.PointAtParameter(0,0)
				
					if i>0:
						ptA = srf.PointAtParameter((i-1)*ustep,j*vstep)
					else:
						ptB = srf.PointAtParameter(i*ustep,j*vstep)
					
					if j>0:
						ptB = srf.PointAtParameter(i*ustep,(j-1)*vstep)
					else:
						ptB = srf.PointAtParameter(i*ustep,j*vstep)
						
					if i<udiv:
						ptC = srf.PointAtParameter((i+1)*ustep,j*vstep)
					else:
						ptC = srf.PointAtParameter(i*ustep,j*vstep)
					
					if j<=(vdiv -1):
						ptD = srf.PointAtParameter(i*ustep,(j+1)*vstep)
					else:
						ptD = srf.PointAtParameter(i*ustep,j*vstep)
						
					if i>0 and j>0 and i<udiv and j<vdiv:
						quad = []
					else:
						if i==0 and j==0:
							quad = []
							#Append to quad
							quad.append(ptB)
							quad.append(ptC)
							quad.append(ptD)
							#Append quads
							quads.append(quad)
							
							#polygons
							poly = Polygon.ByPoints(quad)
							polys.append(poly)
				
							#panels
							panel = Surface.ByPerimeterPoints(quad)
							panels.append(panel)
							
						if i==0 and j==vdiv:
							quad = []
							#Append to quad
							quad.append(ptB)
							quad.append(ptC)
							quad.append(ptD)
							#Append quads
							quads.append(quad)
							
							#polygons
							poly = Polygon.ByPoints(quad)
							polys.append(poly)
				
							#panels
							panel = Surface.ByPerimeterPoints(quad)
							panels.append(panel)
							
						if i==udiv and j==0:
							quad = []
							#Append to quad
							quad.append(ptC)
							quad.append(ptD)
							quad.append(ptA)
							#Append quads
							quads.append(quad)
							
							#polygons
							poly = Polygon.ByPoints(quad)
							polys.append(poly)
				
							#panels
							panel = Surface.ByPerimeterPoints(quad)
							panels.append(panel)
						
						if i==udiv and j==vdiv:
							quad = []
							#Append to quad
							quad.append(ptA)
							quad.append(ptB)
							quad.append(ptC)
							#Append quads
							quads.append(quad)
											
							#polygons
							poly = Polygon.ByPoints(quad)
							polys.append(poly)
				
							#panels
							panel = Surface.ByPerimeterPoints(quad)
							panels.append(panel)
						
						if i == 0 and j > 0 and j < vdiv:
							quad = []
							#Append to quad
							quad.append(ptB)
							quad.append(ptC)
							quad.append(ptD)
							#Append quads
							quads.append(quad)
												
							#polygons
							poly = Polygon.ByPoints(quad)
							polys.append(poly)
				
							#panels
							panel = Surface.ByPerimeterPoints(quad)
							panels.append(panel)
							
						if i == udiv and j > 0 and j < vdiv:
							quad = []
							#Append to quad
							quad.append(ptA)
							quad.append(ptB)
							quad.append(ptD)
							#Append quads
							quads.append(quad)
												
							#polygons
							poly = Polygon.ByPoints(quad)
							polys.append(poly)
				
							#panels
							panel = Surface.ByPerimeterPoints(quad)
							panels.append(panel)
							
						if j == 0 and i > 0 and i < udiv:
							quad = []
							#Append to quad
							quad.append(ptA)
							quad.append(ptC)
							quad.append(ptD)
							#Append quads
							quads.append(quad)
												
							#polygons
							poly = Polygon.ByPoints(quad)
							polys.append(poly)
				
							#panels
							panel = Surface.ByPerimeterPoints(quad)
							panels.append(panel)
							
						if j == vdiv and i > 0 and i < udiv:
							quad = []
							#Append to quad
							quad.append(ptA)
							quad.append(ptB)
							quad.append(ptC)
							#Append quads
							quads.append(quad)
												
							#polygons
							poly = Polygon.ByPoints(quad)
							polys.append(poly)
				
							#panels
							panel = Surface.ByPerimeterPoints(quad)
							panels.append(panel)
		self.panels = panels
		self.quads = quads
		self.polys = polys

#Main code
srf = IN[0]
udiv = IN[1]
vdiv = IN[2]

quads = []
polys = []
panels = []

for k in range(0, len(srf)):
	s = srf[k]
	u = udiv[k]
	v = vdiv[k]
			
	divide = PanelDivision()
	divide.DiamondEdgeDivision(s,u,v)
					
	quads.append(divide.quads)
	panels.append(divide.panels)
	polys.append(divide.polys)
	
output = []
output.append(quads)
output.append(polys)
output.append(panels)

#Assign your output to the OUT variable
OUT = output
# ----------------------------------------
number_2 = DoubleInput(0)
getItemAtIndex_2 = List.GetItemAtIndex(list=python_script_2, index=number_2)
B_Panels_Pts = Output(getItemAtIndex_2)  # "B-Panels Pts"
number_3 = DoubleInput(1)
getItemAtIndex_3 = List.GetItemAtIndex(list=python_script, index=number_3)
A_Panel_Polys = Output(getItemAtIndex_3)  # "A-Panel Polys"
number_4 = DoubleInput(2)
getItemAtIndex_4 = List.GetItemAtIndex(list=python_script, index=number_4)
A_Panel_Faces = Output(getItemAtIndex_4)  # "A-Panel Faces"
number_5 = DoubleInput(1)
getItemAtIndex_5 = List.GetItemAtIndex(list=python_script_2, index=number_5)
B_Panels_Polys = Output(getItemAtIndex_5)  # "B-Panels Polys"
number_6 = DoubleInput(2)
getItemAtIndex_6 = List.GetItemAtIndex(list=python_script_2, index=number_6)
B_Panels_Faces = Output(getItemAtIndex_6)  # "B-Panels Faces"
