# Dynamo custom node DifferentialAngleofListofAngles.dyf (Dynamo 2.6.1.8786)
# category: PracticalBIM.Geometry.Abstract.Vector
# Creates a Diferential Angle with a List of Angles
# packages: PracticalBIM 2020.0.26

listofangles = Input(listofangles: double[])
lastItem = List.LastItem(list=listofangles)
lastDiferentialValue = Input(lastDiferentialValue: double)
code_block = CodeBlock(a=lastItem, b=lastDiferentialValue) { a-b; }
addItemToEnd = List.AddItemToEnd(item=code_block, list=listofangles)
removeLast = Custom[RemoveLast](list=addItemToEnd)  # package PracticalBIM; Remove Last element of a List
code_block_2 = CodeBlock { -1; }
shiftIndices = List.ShiftIndices(list=addItemToEnd, amount=code_block_2)
removeLast_2 = Custom[RemoveLast](list=shiftIndices)
code_block_3 = CodeBlock(a=removeLast, b=removeLast_2) { a-b; }
diferentialangles = Output(code_block_3)  # "diferentialangles:double[]"
