# Dynamo custom node DisplayUnittoInternalUnit.dyf (Dynamo 2.3.0.5885)
# category: PracticalBIM.Units
# Get a Value Converted to Proper Units

val = Input(val: double)
displayUnitType = Input(displayUnitType: var[]..[])
python_script = Python(IN[0]=val, IN[1]=displayUnitType)
# ---------- python_script.python (14 lines) ----------
import clr
clr.AddReference('RevitAPI')
from Autodesk.Revit.DB import *

def ToInternalUnits(val, unittype):
	if str(dispunit.GetType()) == "Autodesk.Revit.DB.DisplayUnitType":
		return UnitUtils.ConvertToInternalUnits(val,unittype)
	else: return None

vals = IN[0]
dispunit = IN[1]

if isinstance(IN[0], list): OUT = [ToInternalUnits(x, dispunit) for x in vals]
else: OUT = ToInternalUnits(vals, dispunit)
# ----------------------------------------
val_2 = Output(python_script)  # "val"
