# Dynamo custom node DivideCurveonRegularSegmentLengthwithEnd.dyf (Dynamo 2.2.1.5175)
# category: PracticalBIM.Geometry.Curves
# Divide the Curve on Regular Segment Lengths with End

curvestodivide = Input(curvestodivide: Autodesk.DesignScript.Geometry.Curve[])
length = Curve.Length(curve=curvestodivide)
moduledivision = Input(moduledivision: double)
code_block = CodeBlock(A=length, n=moduledivision) { A/n; }
round = Math.Round(number=code_block)
code_block_2 = CodeBlock(A=round, n=moduledivision) { 0..#A..n; }
addItemToEnd = List.AddItemToEnd(item=length@L1, list=code_block_2@L2)
SegmenthLengths = Output(addItemToEnd)  # "SegmenthLengths:var[]..[]"
