# Dynamo custom node DoubleTreeColumnStructurebySurface.dyf (Dynamo 2.2.1.5175)
# category: PracticalBIM.Geometry.Structure.Modules
# Creates a Double Tree Column Structure by a Surface and a Distance

surface = Input(surface: Autodesk.DesignScript.Geometry.Surface[])
code_block = CodeBlock { 0.5; }
pointAtParameter = Surface.PointAtParameter(surface=surface, u=code_block, v=code_block)
X = Point.X(point=pointAtParameter)
Y = Point.Y(point=pointAtParameter)
offset = Input(offset: double)
byCoordinates = Point.ByCoordinates(x=X, y=Y, z=offset)
byTwoPoints = Vector.ByTwoPoints(start=pointAtParameter, end=byCoordinates)
code_block_2 = CodeBlock { 2; }
translate = Geometry.Translate(geometry=pointAtParameter, direction=byTwoPoints, distance=code_block_2)
byStartPointEndPoint = Line.ByStartPointEndPoint(startPoint=byCoordinates, endPoint=translate)
Columns = Output(byStartPointEndPoint)  # "Columns: Line"
perimeterCurves = Surface.PerimeterCurves(surface=surface)
code_block_3 = CodeBlock { 0.5; }
pointAtParameter_2 = Curve.PointAtParameter(curve=perimeterCurves, param=code_block_3)
code_block_4 = CodeBlock { 4; }
translate_2 = Geometry.Translate(geometry=pointAtParameter, direction=byTwoPoints, distance=code_block_4)
byStartPointEndPoint_2 = Line.ByStartPointEndPoint(startPoint=pointAtParameter_2, endPoint=translate_2)
startPoint = Curve.StartPoint(curve=perimeterCurves)
byStartPointEndPoint_3 = Line.ByStartPointEndPoint(startPoint=startPoint, endPoint=translate)
list_create = List.Create(item0=byStartPointEndPoint_2, item1=byStartPointEndPoint_3)
flatten = List.Flatten(list=list_create)
framings = Output(flatten)  # "framings:var[]..[]"
