# Dynamo custom node ElementsChangeNames.dyf (Dynamo 2.6.1.8786)
# category: PracticalBIM.Revit.Elements
# Change the Names of Any Element
# packages: PracticalBIM 2020.0.35

name = Input(name: var[]..[])
element = Input(element: var[]..[])
toList = Custom[ToList](variousItems=element)  # package PracticalBIM; Turns a set of elements into one List
toList_2 = Custom[ToList](variousItems=name)
code_block = CodeBlock(seq1=toList, seq2=toList_2)
# ---------- code_block.designscript (4 lines) ----------
num = List.Count(seq1);
cond = List.Count(seq2) < 2 && num > 1;
repseq = List.OfRepeatedItem(seq2[0],num);
cond ? repseq : seq2;
# ----------------------------------------
python_script = Python(IN[0]=toList, IN[1]=code_block.out3)
# ---------- python_script.python (30 lines) ----------
import clr
clr.AddReference('RevitAPI')
from Autodesk.Revit.DB import *

clr.AddReference("RevitNodes")
import Revit
clr.ImportExtensions(Revit.Elements)

clr.AddReference("RevitServices")
import RevitServices
from RevitServices.Persistence import DocumentManager
from RevitServices.Transactions import TransactionManager

doc = DocumentManager.Instance.CurrentDBDocument
items = UnwrapElement(IN[0])
names = IN[1]
booleans = []
counter = 0

TransactionManager.Instance.EnsureInTransaction(doc)
while counter < len(items):
	try:
		items[counter].Name = names[counter]
		booleans.append(True)
	except:
		booleans.append(False)
	counter += 1
TransactionManager.Instance.TransactionTaskDone()

OUT = (items, booleans)
# ----------------------------------------
code_block_2 = CodeBlock(seq=python_script) { seq[0]; seq[1]; }
listOrSingle = Custom[ListOrSingle](Items=name, seq=code_block_2.out0)  # package PracticalBIM; Sets if a result is a list or single
element_2 = Output(listOrSingle)  # "element"
listOrSingle_2 = Custom[ListOrSingle](Items=name, seq=code_block_2.out1)
success = Output(listOrSingle_2)
