# Dynamo custom node ExpandBoundingBoxbydistance.dyf (Dynamo 2.2.1.5175)
# category: PracticalBIM.Geometry.Abstract.BoundingBox
# Expands a Bounding Box by Distance

boundingBox = Input(boundingBox: Autodesk.DesignScript.Geometry.BoundingBox)
minPoint = BoundingBox.MinPoint(boundingBox=boundingBox)
boundingBoxCentroid = Custom[BoundingBoxCentroid](boundingBox=boundingBox)  # Gives the Centroid of a Bounding Box
byTwoPoints = Vector.ByTwoPoints(start=boundingBoxCentroid, end=minPoint)
amount = Input(amount: double)
translate = Geometry.Translate(geometry=minPoint, direction=byTwoPoints, distance=amount)
maxPoint = BoundingBox.MaxPoint(boundingBox=boundingBox)
byTwoPoints_2 = Vector.ByTwoPoints(start=boundingBoxCentroid, end=maxPoint)
translate_2 = Geometry.Translate(geometry=maxPoint, direction=byTwoPoints_2, distance=amount)
byCorners = BoundingBox.ByCorners(min=translate, max=translate_2)
Autodesk_BoundingBox = Output(byCorners)  # "Autodesk.BoundingBox"
