# Dynamo custom node ExtractingConnectorsFromFamilies.dyf (Dynamo 2.2.1.5175)
# category: PracticalBIM.Revit.Elements.MEP.Conduit
# Extract the connector content from Families

Element = Input(Element: var[]..[])
connectors = Custom[Element.Connectors](Element=Element)  # Returns every connector on an element (also return connectors of a System)
sizeRound = Custom[Connector.SizeRound](connector=connectors)  # Returns the Radius of the connector (in feet)
isNull = Object.IsNull(obj=sizeRound)
code_block = CodeBlock { false; }
allIndicesOf = List.AllIndicesOf(list=isNull, item=code_block)
getItemAtIndex = List.GetItemAtIndex(list=connectors, index=allIndicesOf)
ConduitConnector = Output(getItemAtIndex)  # "ConduitConnector:var[]"
direction = Custom[Connector.Direction](connector=connectors)  # Returns the direction of the CoordinateSystem of the Connector
getItemAtIndex_2 = List.GetItemAtIndex(list=direction, index=allIndicesOf)
ConnectorVectors = Output(getItemAtIndex_2)  # "ConnectorVectors:Vector[]"
getItemAtIndex_3 = List.GetItemAtIndex(list=sizeRound, index=allIndicesOf)
convert_between_units = DynamoConvert(getItemAtIndex_3, MeasurementType="Length", FromConversion="Feet", ToConversion="Meters")
code_block_2 = CodeBlock(a=convert_between_units) { a*1000*2; }
ConnectorSize = Output(code_block_2)  # "ConnectorSize:double[]"
location = Custom[Connector.Location](connector=connectors)  # Returns the location of a connector
getItemAtIndex_4 = List.GetItemAtIndex(list=location, index=allIndicesOf)
ConnectorPoints = Output(getItemAtIndex_4)  # "ConnectorPoints:Point[]"
