# Dynamo custom node ExtractingConnectorsOFConduitSurface.dyf (Dynamo 2.2.1.5175)
# category: PracticalBIM.Revit.Elements.MEP.Conduit
# Extracts the connectors of Type Conduit Surface

Element = Input(Element: var)
connectors = Custom[Element.Connectors](Element=Element)  # Returns every connector on an element (also return connectors of a System)
location = Custom[Connector.Location](connector=connectors)  # Returns the location of a connector
isNull = Object.IsNull(obj=location)
code_block = CodeBlock { false; }
allIndicesOf = List.AllIndicesOf(list=isNull, item=code_block)
getItemAtIndex = List.GetItemAtIndex(list=connectors, index=allIndicesOf)
ConduitConnector = Output(getItemAtIndex)  # "ConduitConnector:var[]"
direction = Custom[Connector.Direction](connector=connectors)  # Returns the direction of the CoordinateSystem of the Connector
getItemAtIndex_2 = List.GetItemAtIndex(list=direction, index=allIndicesOf)
ConnectorVectors = Output(getItemAtIndex_2)  # "ConnectorVectors:Vector[]"
getItemAtIndex_3 = List.GetItemAtIndex(list=location, index=allIndicesOf)
ConnectorPoints = Output(getItemAtIndex_3)  # "ConnectorPoints:Point[]"
geometry = Element.Geometry(element=Element)
explode = Geometry.Explode(geometry=geometry)
flatten = List.Flatten(list=explode)
doesIntersect = Geometry.DoesIntersect(geometry=flatten, other=getItemAtIndex_3, lacing=CrossProduct)
flatten_2 = List.Flatten(list=doesIntersect)
code_block_2 = CodeBlock { true; }
allIndicesOf_2 = List.AllIndicesOf(list=flatten_2, item=code_block_2)
getItemAtIndex_4 = List.GetItemAtIndex(list=flatten, index=allIndicesOf_2)
SurfaceGeometry = Output(getItemAtIndex_4)  # "SurfaceGeometry:Surface[]"
