# Dynamo custom node FireProtectionSystemsUptoPipeLine.dyf (Dynamo 2.2.1.5175)
# category: PracticalBIM.Revit.Elements.MEP.FireProtection
# Creates Lines to connect sprinklers UP

connectorpoint = Input(connectorpoint: Autodesk.DesignScript.Geometry.Point[])
Connectordirection = Input(Connectordirection: Autodesk.DesignScript.Geometry.Vector[])
connectorradius = Input(connectorradius: double[])
code_block = CodeBlock(a=connectorradius) { a*0.3048*2; }
code_block_2 = CodeBlock(a=code_block) { a*4; }
translate = Geometry.Translate(geometry=connectorpoint, direction=Connectordirection, distance=code_block_2)
line1 = Line.ByStartPointEndPoint(startPoint=connectorpoint, endPoint=translate)
Line1 = Output(line1)  # "Line1:Line[]"
pipeCurve = Input(pipeCurve: Autodesk.DesignScript.Geometry.Curve)
changePointZValueofaPointwithaLine = Custom[ChangePointZValueofaPointwithaLine](point=connectorpoint, curve=pipeCurve)  # Changes the Point Z Value of a Point with a Line
closestPointTo = Geometry.ClosestPointTo(geometry=pipeCurve, other=changePointZValueofaPointwithaLine)
byTwoPoints = Vector.ByTwoPoints(start=changePointZValueofaPointwithaLine, end=closestPointTo)
translate_2 = Geometry.Translate(geometry=translate, direction=byTwoPoints, distance=code_block_2)
line2 = Line.ByStartPointEndPoint(startPoint=translate, endPoint=translate_2)
Line2 = Output(line2)  # "Line2:Line[]"
changePointZValueofaPointwithaLine_2 = Custom[ChangePointZValueofaPointwithaLine](point=translate_2, curve=pipeCurve)
line3 = Line.ByStartPointEndPoint(startPoint=translate_2, endPoint=changePointZValueofaPointwithaLine_2)
Line3 = Output(line3)  # "Line3:Line[]"
line4 = Line.ByStartPointEndPoint(startPoint=changePointZValueofaPointwithaLine_2, endPoint=closestPointTo)
Line4 = Output(line4)  # "Line4:Line[]"
