# Dynamo custom node FlattentoNavisworkstime.dyf (Dynamo 2.2.1.5175)
# category: PracticalBIM.4dSimulation
# Flatten DateTime to a Format for Navisworks

DateTimesto = Input(DateTimesto: var[])
code_block = CodeBlock { "dd/MM/yyyy hh:mm tt"; }
format = DateTime.Format(dateTime=DateTimesto, format=code_block)
NavDateTime = Output(format)  # "NavDateTime:string[]"
