# Dynamo custom node FloorByNewGeometry.dyf (Dynamo 2.2.1.5175)
# category: PracticalBIM.Revit.Elements.Floor
# Creates New Floors Using original Floor values and using New Geometry

outline = Input(outline: Autodesk.DesignScript.Geometry.PolyCurve[])
originalelement = Input(originalelement: Revit.Elements.Element)
code_block = CodeBlock { "Type"; }
getParameterValueByName = Element.GetParameterValueByName(element=originalelement, parameterName=code_block)
code_block_2 = CodeBlock { "Level"; }
getParameterValueByName_2 = Element.GetParameterValueByName(element=originalelement, parameterName=code_block_2)
byOutlineTypeAndLevel = Floor.ByOutlineTypeAndLevel(outline=outline, floorType=getParameterValueByName, level=getParameterValueByName_2)
Floor = Output(byOutlineTypeAndLevel)
