# Dynamo custom node FloorOutlineCurves.dyf (Dynamo 2.2.1.5175)
# category: PracticalBIM.Revit.Elements.Floor
# Get the Outline Curves of a Floor Element

floorelement = Input(floorelement: Revit.Elements.Element)
geometry = Element.Geometry(element=floorelement)
code_block = CodeBlock { "Level"; }
getParameterValueByName = Element.GetParameterValueByName(element=floorelement, parameterName=code_block)
code_block_2 = CodeBlock { "Elevation"; }
getParameterValueByName_2 = Element.GetParameterValueByName(element=getParameterValueByName, parameterName=code_block_2)
byCoordinates = Point.ByCoordinates(z=getParameterValueByName_2)
code_block_3 = CodeBlock { 2; }
byCoordinates_2 = Vector.ByCoordinates(z=code_block_3)
byOriginNormal = Plane.ByOriginNormal(origin=byCoordinates, normal=byCoordinates_2)
intersect = Geometry.Intersect(geometry=geometry, other=byOriginNormal)
flatten = List.Flatten(list=intersect)
perimeterCurves = Surface.PerimeterCurves(surface=flatten)
Curve = Output(perimeterCurves)  # "Curve[]"
