# Dynamo custom node FloorPolycurvesbyIntersectionwithGrids.dyf (Dynamo 2.2.1.5175)
# category: PracticalBIM.Revit.Elements.Floor
# Create Polycurve Floors by Intersection with Grids

floorelement = Input(floorelement: Revit.Elements.Element)
geometry = Element.Geometry(element=floorelement)
gridplanesfordivisionV = Input(gridplanesfordivisionV: Autodesk.DesignScript.Geometry.Plane[])
splitSolidbyPlanes = Custom[SplitSolidbyPlanes](solidtodivide=geometry, planesfordivision=gridplanesfordivisionV)  # Splits a Solid element by Planes sorted
gridplanesfordivisionH = Input(gridplanesfordivisionH: Autodesk.DesignScript.Geometry.Plane[])
splitSolidbyPlanes_2 = Custom[SplitSolidbyPlanes](solidtodivide=splitSolidbyPlanes, planesfordivision=gridplanesfordivisionH)
flatten = List.Flatten(list=splitSolidbyPlanes_2)
code_block = CodeBlock { false; }
clean = List.Clean(list=flatten, preserveIndices=code_block)
code_block_2 = CodeBlock { "Level"; }
getParameterValueByName = Element.GetParameterValueByName(element=floorelement, parameterName=code_block_2)
code_block_3 = CodeBlock { "Elevation"; }
getParameterValueByName_2 = Element.GetParameterValueByName(element=getParameterValueByName, parameterName=code_block_3)
byCoordinates = Point.ByCoordinates(z=getParameterValueByName_2)
code_block_4 = CodeBlock { 2; }
byCoordinates_2 = Vector.ByCoordinates(z=code_block_4)
byOriginNormal = Plane.ByOriginNormal(origin=byCoordinates, normal=byCoordinates_2)
intersect = Geometry.Intersect(geometry=clean, other=byOriginNormal)
flatten_2 = List.Flatten(list=intersect)
perimeterCurves = Surface.PerimeterCurves(surface=flatten_2)
byJoinedCurves = PolyCurve.ByJoinedCurves(curves=perimeterCurves)
FloorPolycurves = Output(byJoinedCurves)  # "FloorPolycurves:PolyCurve[]"
