# Dynamo custom node FloorbyLevelandtwosetsofPoints.dyf (Dynamo 2.2.1.5175)
# category: PracticalBIM.Revit.Elements.Floor
# Creates a Floor by a Level and two sets of Points

point = Input(point: Autodesk.DesignScript.Geometry.Point[])
X = Point.X(point=point)
Y = Point.Y(point=point)
level = Input(level: Revit.Elements.Level)
elevation = Level.Elevation(level=level)
byCoordinates = Point.ByCoordinates(x=X, y=Y, z=elevation)
byControlPoints = NurbsCurve.ByControlPoints(points=byCoordinates)
point_2 = Input(point: Autodesk.DesignScript.Geometry.Point[])
X_2 = Point.X(point=point_2)
Y_2 = Point.Y(point=point_2)
byCoordinates_2 = Point.ByCoordinates(x=X_2, y=Y_2, z=elevation)
byControlPoints_2 = NurbsCurve.ByControlPoints(points=byCoordinates_2)
list_create = List.Create(item0=byControlPoints, item1=byControlPoints_2)
byLoft = Surface.ByLoft(crossSections=list_create)
perimeterCurves = Surface.PerimeterCurves(surface=byLoft)
floorType = Input(floorType: Revit.Elements.FloorType)
byOutlineTypeAndLevel = Floor.ByOutlineTypeAndLevel(outlineCurves=perimeterCurves, floorType=floorType, level=level)
Floor = Output(byOutlineTypeAndLevel)
