# Dynamo custom node FloorbyLevelandtwosetsofPointsM.dyf (Dynamo 2.2.1.5175)
# category: PracticalBIM.Revit.Elements.Floor
# Creates multiple floors by two sets of points

point = Input(point: Autodesk.DesignScript.Geometry.Point[])
X = Point.X(point=point)
Y = Point.Y(point=point)
level = Input(level: Revit.Elements.Level)
elevation = Level.Elevation(level=level)
byCoordinates = Point.ByCoordinates(x=X, y=Y, z=elevation)
byControlPoints = NurbsCurve.ByControlPoints(points=byCoordinates)
point_2 = Input(point: Autodesk.DesignScript.Geometry.Point[])
X_2 = Point.X(point=point_2)
Y_2 = Point.Y(point=point_2)
byCoordinates_2 = Point.ByCoordinates(x=X_2, y=Y_2, z=elevation)
byControlPoints_2 = NurbsCurve.ByControlPoints(points=byCoordinates_2)
list_create = List.Create(item0=byControlPoints, item1=byControlPoints_2)
transpose = List.Transpose(lists=list_create)
byLoft = Surface.ByLoft(crossSections=transpose)
perimeterCurves = Surface.PerimeterCurves(surface=byLoft)
Curve = Output(perimeterCurves)  # "Curve[]"
