# Dynamo custom node GenericOverrideColorinViewbyGroupsandKeys.dyf (Dynamo 2.2.1.5175)
# category: PracticalBIM.Revit.Elements.Element
# Creates a Generic Override Color in View using Groups of elements and their Keys

element = Input(element: Revit.Elements.Element[]..[])
list = Input(list: var[])
count = List.Count(list=list)
code_block = CodeBlock(n=count) { 0..1..#n; }
color_range = ColorRange(value=code_block)  # unwired: colors, indices
overrideColorInView = Element.OverrideColorInView(element=element, color=color_range)
Element = Output(overrideColorInView)  # "Element[]..[]"
Color = Output(color_range)
