# Dynamo custom node GeometryCloseObject.dyf (Dynamo 2.2.1.5175)
# category: PracticalBIM.Geometry.Modifiers
# Gets the Closest Object to Geometry

other = Input(other: Autodesk.DesignScript.Geometry.Geometry[])
geometry = Input(geometry: Autodesk.DesignScript.Geometry.Geometry[])
distanceTo = Geometry.DistanceTo(geometry=geometry, other=other, lacing=CrossProduct)
minimumItem = List.MinimumItem(list=distanceTo)
indexOf = List.IndexOf(list=distanceTo, element=minimumItem)
getItemAtIndex = List.GetItemAtIndex(list=other, index=indexOf)
item = Output(getItemAtIndex)
