# Dynamo custom node GeometryFarObject.dyf (Dynamo 2.2.1.5175)
# category: PracticalBIM.Geometry.Modifiers
# Gets the geometry Farest Object

geometry = Input(geometry: Autodesk.DesignScript.Geometry.Geometry[])
other = Input(other: Autodesk.DesignScript.Geometry.Geometry[])
distanceTo = Geometry.DistanceTo(geometry=geometry, other=other, lacing=CrossProduct)
flatten = List.Flatten(list=distanceTo)
maximumItem = List.MaximumItem(list=flatten)
indexOf = List.IndexOf(list=flatten, element=maximumItem)
getItemAtIndex = List.GetItemAtIndex(list=geometry, index=indexOf)
FarObject = Output(getItemAtIndex)
