# Dynamo custom node Get2ParametersTypeValueandADefaultfromElements.dyf (Dynamo 2.2.1.5175)
# category: PracticalBIM.Revit.Elements.Element
# Gets 2 Type parameters Value on a list and complements with a default value for getting distance on vectors

element = Input(element: Revit.Elements.Element)
code_block = CodeBlock { "Type"; }
getParameterValueByName = Element.GetParameterValueByName(element=element, parameterName=code_block)
parameterName = Input(parameterName: string)
getParameterValueByName_2 = Element.GetParameterValueByName(element=getParameterValueByName, parameterName=parameterName)
code_block_2 = CodeBlock { ""; }
eq = getParameterValueByName_2 == code_block_2
parameterName_2 = Input(parameterName: string)
getParameterValueByName_3 = Element.GetParameterValueByName(element=getParameterValueByName, parameterName=parameterName_2)
code_block_3 = CodeBlock { ""; }
eq_2 = getParameterValueByName_3 == code_block_3
defaultvalue = Input(defaultvalue: double)
if_ = If(test=eq_2, true=defaultvalue, false=getParameterValueByName_3)
code_block_4 = CodeBlock(a=getParameterValueByName_2) { a+0.5; }
if_2 = If(test=eq, true=if_, false=code_block_4)
ValuesforOffset = Output(if_2)  # "ValuesforOffset[]"
