# Dynamo custom node Get3ClosestPointsIndexesanditsaveragemultiplicationvalues.dyf (Dynamo 2.2.1.5175)
# category: PracticalBIM.Revit.Elements.SoilMechanics
# Get the three closest points from a list from an element and its multiplication values

AllPointsToTranslate = Input(AllPointsToTranslate: Autodesk.DesignScript.Geometry.Point[])
TestPoints = Input(TestPoints: Autodesk.DesignScript.Geometry.Point[])
distanceTo = Geometry.DistanceTo(geometry=AllPointsToTranslate, other=TestPoints, lacing=CrossProduct)
minimumItem = List.MinimumItem(list=distanceTo)
indexOf = List.IndexOf(list=distanceTo@L2, element=minimumItem@L1)
removeItemAtIndex = List.RemoveItemAtIndex(list=distanceTo@L2, indices=indexOf@L1)
minimumItem_2 = List.MinimumItem(list=removeItemAtIndex)
indexOf_2 = List.IndexOf(list=removeItemAtIndex@L2, element=minimumItem_2@L1)
removeItemAtIndex_2 = List.RemoveItemAtIndex(list=removeItemAtIndex@L2, indices=indexOf_2@L1)
minimumItem_3 = List.MinimumItem(list=removeItemAtIndex_2)
code_block = CodeBlock(a=minimumItem, b=minimumItem_2, c=minimumItem_3) { a+b+c; }
code_block_2 = CodeBlock(b=code_block, a=minimumItem_3) { b-a; }
code_block_3 = CodeBlock(b=code_block, a=minimumItem) { b-a; }
code_block_4 = CodeBlock(b=code_block, a=minimumItem_2) { b-a; }
code_block_5 = CodeBlock(a=code_block_3, b=code_block_4, c=code_block_2) { a+b+c; }
code_block_6 = CodeBlock(a=code_block_2, b=code_block_5) { a/b; }
code_block_7 = CodeBlock { 2; }
round = Math.Round(number=code_block_6, digits=code_block_7)
listofdistances = Output(distanceTo)  # "listofdistances:double[]..[]"
Number1Index = Output(indexOf)  # "Number1Index:int[]"
indexOf_3 = List.IndexOf(list=distanceTo@L2, element=minimumItem_2@L1)
Number2Index = Output(indexOf_3)  # "Number2Index:int[]"
indexOf_4 = List.IndexOf(list=distanceTo@L2, element=minimumItem_3@L1)
Number3Index = Output(indexOf_4)  # "Number3Index:int[]"
code_block_8 = CodeBlock(a=code_block_3, b=code_block_5) { a/b; }
round_2 = Math.Round(number=code_block_8, digits=code_block_7)
code_block_9 = CodeBlock { 0.30; }
ge = round_2 >= code_block_9
code_block_10 = CodeBlock { 0.60; }
code_block_11 = CodeBlock { 1; }
remapRange = Math.RemapRange(numbers=round_2, newMin=code_block_10, newMax=code_block_11)
if_ = If(test=ge, true=remapRange, false=round_2)
Number1factorValue = Output(if_)  # "Number1factorValue:double[]"
code_block_12 = CodeBlock(a=code_block_4, b=code_block_5) { a/b; }
round_3 = Math.Round(number=code_block_12, digits=code_block_7)
code_block_13 = CodeBlock(a=if_) { 1-a; }
ge_2 = round_3 >= code_block_13
if_2 = If(test=ge_2, true=code_block_13, false=round_3)
Number2factorValue = Output(if_2)  # "Number2factorValue:double[]"
code_block_14 = CodeBlock(a=if_, b=if_2) { 1-a-b; }
Number3factorValue = Output(code_block_14)  # "Number3factorValue:double[]"
