# Dynamo custom node GetAllElementsfromLinkedFile.dyf (Dynamo 2.2.1.5175)
# category: PracticalBIM.Revit.Elements.Element
# Gets all Elements from a Linked File

document = Input(document: var)
firstItem = List.FirstItem(list=document)
categories = Input(categories: Revit.Elements.Category)
linkinstance = Input(linkinstance: var)
python_script = Python(IN[0]=firstItem, IN[1]=categories, IN[2]=linkinstance)
# ---------- python_script.python (43 lines) ----------
import System
import clr
clr.AddReference('ProtoGeometry')
from Autodesk.DesignScript.Geometry import *
# Import ToDSType(bool) extension method
clr.AddReference("RevitNodes")
import Revit
clr.ImportExtensions(Revit.Elements)
# Import geometry conversion extension methods
clr.ImportExtensions(Revit.GeometryConversion)
# Import DocumentManager and TransactionManager
clr.AddReference("RevitServices")
import RevitServices
from RevitServices.Persistence import DocumentManager
from RevitServices.Transactions import TransactionManager
from System.Collections.Generic import *
# Import RevitAPI
clr.AddReference("RevitAPI")
import Autodesk
from Autodesk.Revit.DB import *

doc = DocumentManager.Instance.CurrentDBDocument
uiapp = DocumentManager.Instance.CurrentUIApplication
app = uiapp.Application
uidoc=DocumentManager.Instance.CurrentUIApplication.ActiveUIDocument

LinkDoc=IN[0]
cat = IN[1]
LinkInst = IN[2]

BuiltIn = System.Enum.ToObject(BuiltInCategory, cat.Id)

elementlist = []
typelist=[]
T = []


collector = FilteredElementCollector(LinkDoc)
filter = ElementCategoryFilter(BuiltIn)
list=collector.WherePasses(filter).WhereElementIsNotElementType().ToElements()


OUT = list
# ----------------------------------------
Element_s = Output(python_script)  # "Element(s)"
