# Dynamo custom node GetAllFamilyTypesbyName.dyf (Dynamo 2.6.1.8786)
# category: PracticalBIM.Revit.Elements.FamilyTypes
# Gets All family Types by Type Name

name = Input(name: string)
byName = Family.ByName(name=name)
types = Family.Types(family=byName)
name_2 = FamilyType.Name(familyType=types)
element = Input(element: var)
indexOf = List.IndexOf(list=name_2, element=element)
getItemAtIndex = List.GetItemAtIndex(list=types, index=indexOf)
item = Output(getItemAtIndex)
