# Dynamo custom node GetAngleHorizontalandVerticalofaLine.dyf (Dynamo 2.3.0.5885)
# category: PracticalBIM.Geometry.Curves
# Gets the Horizontal and vertical Angles of a Line by its properties
# packages: PracticalBIM 2020.0.28

SelectedLine = Input(SelectedLine: Autodesk.DesignScript.Geometry.Line[])
startPoint = Curve.StartPoint(curve=SelectedLine)
StartPoint = Output(startPoint)  # "StartPoint:Point"
direction = Line.Direction(line=SelectedLine)
X = Vector.X(vector=direction)
Y = Vector.Y(vector=direction)
byCoordinates = Vector.ByCoordinates(x=X, y=Y)
angleWithVector = Vector.AngleWithVector(vector=direction, otherVector=byCoordinates)
Z = Point.Z(point=startPoint)
endPoint = Curve.EndPoint(curve=SelectedLine)
Z_2 = Point.Z(point=endPoint)
code_block = CodeBlock(a=Z, b=Z_2) { a-b; }
code_block_2 = CodeBlock { 0; }
lt = code_block < code_block_2
code_block_3 = CodeBlock { 1; }
code_block_4 = CodeBlock { -1; }
if_ = If(test=lt, true=code_block_3, false=code_block_4)
code_block_5 = CodeBlock(a=angleWithVector, b=if_) { a*b; }
VerticalAngle = Output(code_block_5)  # "VerticalAngle:double"
getAngleofRotationofFamilyInstance = Custom[GetAngleofRotationofFamilyInstance](OrientationVector=direction)  # package PracticalBIM; Gets the Angle of Rotation of a Family Instance
code_block_6 = CodeBlock(a=getAngleofRotationofFamilyInstance) { a-90; }
HorizontalAngle = Output(code_block_6)  # "HorizontalAngle:double"
