# Dynamo custom node GetAngleSlopeofaLineinZ.dyf (Dynamo 2.6.1.8786)
# category: PracticalBIM.Geometry.Curves
# Gets the Angle Slope of a Line in Z Values

curve = Input(curve: Autodesk.DesignScript.Geometry.Curve[])
endPoint = Curve.EndPoint(curve=curve)
Z = Point.Z(point=endPoint)
startPoint = Curve.StartPoint(curve=curve)
Z_2 = Point.Z(point=startPoint)
code_block = CodeBlock(a=Z, b=Z_2) { a-b; }
length = Curve.Length(curve=curve)
code_block_2 = CodeBlock(a=code_block, b=length) { a/b; }
atan = Math.Atan(ratio=code_block_2)
angle = Output(atan)
