# Dynamo custom node GetAngleofRotationofFamilyInstance.dyf (Dynamo 2.2.1.5175)
# category: PracticalBIM.Revit.Elements.FamilyInstance
# Gets the Angle of Rotation of a Family Instance

OrientationVector = Input(OrientationVector: Autodesk.DesignScript.Geometry.Vector)
X = Vector.X(vector=OrientationVector)
Y = Vector.Y(vector=OrientationVector)
byCoordinates = Vector.ByCoordinates(x=X, y=Y)
X_2 = Vector.X(vector=byCoordinates)
code_block = CodeBlock { 0; }
gt = X_2 > code_block
code_block_2 = CodeBlock { 1; }
byCoordinates_2 = Vector.ByCoordinates(y=code_block_2)
angleWithVector = Vector.AngleWithVector(vector=byCoordinates_2, otherVector=byCoordinates)
code_block_3 = CodeBlock(a=angleWithVector) { a*-1; }
if_ = If(test=gt, true=angleWithVector, false=code_block_3)
AngleofRotation = Output(if_)
