# Dynamo custom node GetAngleofRotationofFamilyInstanceX.dyf (Dynamo 2.6.1.8786)
# category: PracticalBIM.Revit.Elements.Element
# Gets the Angle of Rotation of a Family Instance Drawn on X Grid

OrientationVector = Input(OrientationVector: Autodesk.DesignScript.Geometry.Vector)
X = Vector.X(vector=OrientationVector)
Y = Vector.Y(vector=OrientationVector)
byCoordinates = Vector.ByCoordinates(x=X, y=Y)
Y_2 = Vector.Y(vector=byCoordinates)
code_block = CodeBlock { 0; }
gt = Y_2 > code_block
code_block_2 = CodeBlock { 1; }
byCoordinates_2 = Vector.ByCoordinates(x=code_block_2)
angleWithVector = Vector.AngleWithVector(vector=byCoordinates_2, otherVector=byCoordinates)
code_block_3 = CodeBlock(a=angleWithVector) { a*-1; }
if_ = If(test=gt, true=code_block_3, false=angleWithVector)
AngleofRotation = Output(if_)
