# Dynamo custom node GetBendRadiusofCableTray.dyf (Dynamo 2.2.1.5175)
# category: PracticalBIM.Revit.Elements.MEP.CableTray
# Gets the Bend Radius of a Cable Tray

element = Input(element: Revit.Elements.Element)
code_block = CodeBlock { "Width"; }
getParameterValueByName = Element.GetParameterValueByName(element=element, parameterName=code_block)
code_block_2 = CodeBlock { "Type"; }
getParameterValueByName_2 = Element.GetParameterValueByName(element=element, parameterName=code_block_2)
code_block_3 = CodeBlock { "Bend Radius Multiplier"; }
getParameterValueByName_3 = Element.GetParameterValueByName(element=getParameterValueByName_2, parameterName=code_block_3)
code_block_4 = CodeBlock(a=getParameterValueByName, b=getParameterValueByName_3) { a*b; }
BendRadiusvalue = Output(code_block_4)  # "BendRadiusvalue:double"
