# Dynamo custom node GetBestFitthroughpointsofmultiplelinesbygroups.dyf (Dynamo 2.2.1.5175)
# category: PracticalBIM.Geometry.Curves
# Get the Best Fit through Points of Multiple LInes by Groups

ElementCurve = Input(ElementCurve: Autodesk.DesignScript.Geometry.Curve[])
code_block = CodeBlock { "_"; }
code_block_2 = CodeBlock { 0.5; }
pointAtParameter = Curve.PointAtParameter(curve=ElementCurve, param=code_block_2)
intersectionRadius = Input(intersectionRadius: double)
byCenterPointRadius = Sphere.ByCenterPointRadius(centerPoint=pointAtParameter, radius=intersectionRadius)
doesIntersect = Geometry.DoesIntersect(geometry=byCenterPointRadius, other=byCenterPointRadius, lacing=CrossProduct)
code_block_3 = CodeBlock { true; }
allIndicesOf = List.AllIndicesOf(list=doesIntersect@L2, item=code_block_3)
sort = List.Sort(list=allIndicesOf@L2)
string_from_object = FromObject(obj=sort)
join = String.Join(separator=code_block, string0=string_from_object)
uniqueItems = List.UniqueItems(list=join@L2)
flatten = List.Flatten(list=uniqueItems)
split = String.Split(str=flatten, separator0=code_block)
toNumber = String.ToNumber(str=split)
getItemAtIndex = List.GetItemAtIndex(list=ElementCurve, index=toNumber)
startPoint = Curve.StartPoint(curve=getItemAtIndex)
endPoint = Curve.EndPoint(curve=getItemAtIndex)
list_create = List.Create(item0=startPoint, item1=endPoint)
transpose = List.Transpose(lists=list_create)
code_block_4 = CodeBlock { 1; }
flatten_2 = List.Flatten(list=transpose@L3, amt=code_block_4)
byBestFitThroughPoints = Line.ByBestFitThroughPoints(bestFitPoints=flatten_2)
BestFitLines = Output(byBestFitThroughPoints)  # "BestFitLines:Line[]"
elementindexes = Output(toNumber)  # "elementindexes:double[]"
