# Dynamo custom node GetBottomConnectors.dyf (Dynamo 2.2.1.5175)
# category: PracticalBIM.Revit.Elements.MEP.Connectors
# Get the Bottom Connectors of a List

list = Input(list: var[])
point = Input(point: Autodesk.DesignScript.Geometry.Point[])
Z = Point.Z(point=point)
minimumItem = List.MinimumItem(list=Z)
allIndicesOf = List.AllIndicesOf(list=Z, item=minimumItem)
getItemAtIndex = List.GetItemAtIndex(list=list, index=allIndicesOf)
bottomconnectors = Output(getItemAtIndex)  # "bottomconnectors[]"
