# Dynamo custom node GetCollidingElementsofTags.dyf (Dynamo 2.2.1.5175)
# category: PracticalBIM.GN
# Gets first and second element of Colliding Tags

curves = Input(curves: Autodesk.DesignScript.Geometry.Curve[])
byJoinedCurves = PolyCurve.ByJoinedCurves(curves=curves)
byPatch = Surface.ByPatch(closedCurve=byJoinedCurves)
geometryToProject = Input(geometryToProject: Autodesk.DesignScript.Geometry.Geometry[])
code_block = CodeBlock { 0.5; }
normalAtParameter = Surface.NormalAtParameter(surface=byPatch, u=code_block, v=code_block)
reverse = Vector.Reverse(vector=normalAtParameter)
projectInputOnto = Surface.ProjectInputOnto(surface=byPatch, geometryToProject=geometryToProject, projectionDirection=reverse)
distancesize = Input(distancesize: double)
byCenterPointRadius = Sphere.ByCenterPointRadius(centerPoint=projectInputOnto, radius=distancesize)
flatten = List.Flatten(list=byCenterPointRadius)
doesIntersect = Geometry.DoesIntersect(geometry=flatten, other=flatten, lacing=CrossProduct)
code_block_2 = CodeBlock { true; }
allIndicesOf = List.AllIndicesOf(list=doesIntersect@L2, item=code_block_2)
count = List.Count(list=allIndicesOf@L2)
code_block_3 = CodeBlock { 1; }
gt = count > code_block_3
code_block_4 = CodeBlock { true; }
allIndicesOf_2 = List.AllIndicesOf(list=gt, item=code_block_4)
getItemAtIndex = List.GetItemAtIndex(list=allIndicesOf, index=allIndicesOf_2)
uniqueItems = List.UniqueItems(list=getItemAtIndex)
code_block_5 = CodeBlock { 0; }
getItemAtIndex_2 = List.GetItemAtIndex(list=uniqueItems@L2, index=code_block_5)
indexesofFirstColliding = Output(getItemAtIndex_2)  # "indexesofFirstColliding[]"
code_block_6 = CodeBlock { 1; }
getItemAtIndex_3 = List.GetItemAtIndex(list=uniqueItems@L2, index=code_block_6)
indexesofSecondColliding = Output(getItemAtIndex_3)  # "indexesofSecondColliding[]"
ProyectedGeometry = Output(projectInputOnto)  # "ProyectedGeometry:Geometry[]"
Spheres = Output(flatten)  # "Spheres:Geometry[]"
