# Dynamo custom node GetCombinedStartsofStartsLevelAndDuration.dyf (Dynamo 2.2.1.5175)
# category: PracticalBIM.4dSimulation
# Gets Combined Starts of Starts of Level and Duration

StartDaysofLevel = Input(StartDaysofLevel: double[])
GroupsofLevel = Input(GroupsofLevel: string[]..[])
flatten = List.Flatten(list=GroupsofLevel)
CategoryandLevels = Input(CategoryandLevels: string[])
flatten_2 = List.Flatten(list=CategoryandLevels)
indexOf = List.IndexOf(list=flatten, element=flatten_2)
getItemAtIndex = List.GetItemAtIndex(list=StartDaysofLevel, index=indexOf)
code_block = CodeBlock { 0; }
code_block_2 = CodeBlock { "_"; }
indexOf_2 = String.IndexOf(str=CategoryandLevels, searchFor=code_block_2)
substring = String.Substring(str=CategoryandLevels, startIndex=code_block, length=indexOf_2)
groupByKey = List.GroupByKey(list=getItemAtIndex, keys=substring)
StartDaysbyCategory = Input(StartDaysbyCategory: double[])
gt = groupByKey.groups > StartDaysbyCategory
if_ = If(test=gt, true=groupByKey.groups, false=StartDaysbyCategory)
StartDaysLandD = Output(if_)  # "StartDaysLandD:double[]"
