# Dynamo custom node GetCompresedStringF_N.dyf (Dynamo 2.3.0.5885)
# category: PracticalBIM.String.Extraction
# Gets from a string first Character and number as string next to a black space

values = Input(values: string[])
code_block = CodeBlock { 0; }
code_block_2 = CodeBlock { 1; }
substring = String.Substring(str=values, startIndex=code_block, length=code_block_2)
code_block_3 = CodeBlock { " "; }
indexOf = String.IndexOf(str=values, searchFor=code_block_3)
code_block_4 = CodeBlock(a=indexOf) { a+1; }
length = String.Length(str=values)
code_block_5 = CodeBlock(a=length, b=code_block_4) { a-b; }
substring_2 = String.Substring(str=values, startIndex=code_block_4, length=code_block_5)
code_block_6 = CodeBlock(a=substring, b=substring_2) { a+b; }
stringscompresed = Output(code_block_6)  # "stringscompresed:string[]"
