# Dynamo custom node GetCropBoxCurvesfromView.dyf (Dynamo 2.2.1.5175)
# category: PracticalBIM.Revit.View
# Gets the Crop Boxes as Curves from View

views = Input(views: var[]..[])
python_script = Python(IN[0]=views)
# ---------- python_script.python (36 lines) ----------
import clr
clr.AddReference('ProtoGeometry')
from Autodesk.DesignScript.Geometry import *

import clr

clr.AddReference("RevitNodes")
import Revit

# Import ToProtoType, ToRevitType geometry conversion extension methods
clr.ImportExtensions(Revit.GeometryConversion)

#The inputs to this node will be stored as a list in the IN variables.
if isinstance(IN[0], list):
	view = UnwrapElement(IN[0])
	toggle = 0
else:
	view = [UnwrapElement(IN[0])]
	toggle = 1
	
listout = []
for x in view:
	region = x.GetCropRegionShapeManager().GetCropShape()
	if len(region) > 0:
		lines = [y.ToProtoType() for y in region[0]]
		listout.append(lines)
	else:
		listout.append([])



#Assign your output to the OUT variable.
if toggle == 0:
	OUT = listout
else:
	OUT = lines
# ----------------------------------------
Curves = Output(python_script)
