# Dynamo custom node GetDistancesFromIntersectionbyVectorsandPoints.dyf (Dynamo 2.6.1.8786)
# category: PracticalBIM.Geometry.Curves
# Get Distances From Intersection by Vectors and Points
# packages: PracticalBIM 2020.0.26

remainderofDistance = Input(remainderofDistance: double)
PointsofLocation = Input(PointsofLocation: Autodesk.DesignScript.Geometry.Point[])
ResultingVectors = Input(ResultingVectors: Autodesk.DesignScript.Geometry.Vector[])
reverse = Vector.Reverse(vector=ResultingVectors)
distanceofelement = Input(distanceofelement: double)
translate = Geometry.Translate(geometry=PointsofLocation, direction=reverse, distance=distanceofelement)
translate_2 = Geometry.Translate(geometry=PointsofLocation, direction=ResultingVectors, distance=distanceofelement)
byStartPointEndPoint = Line.ByStartPointEndPoint(startPoint=translate, endPoint=translate_2)
removeLast = Custom[RemoveLast](list=byStartPointEndPoint)  # package PracticalBIM; Remove Last element of a List
code_block = CodeBlock { -1; }
shiftIndices = List.ShiftIndices(list=byStartPointEndPoint, amount=code_block)
removeLast_2 = Custom[RemoveLast](list=shiftIndices)
intersect = Geometry.Intersect(geometry=removeLast, other=removeLast_2)
flatten = List.Flatten(list=intersect)
restOfItems = List.RestOfItems(list=PointsofLocation)
distanceTo = Geometry.DistanceTo(geometry=flatten, other=restOfItems)
addItemToFront = List.AddItemToFront(item=remainderofDistance, list=distanceTo)
StartingDistances = Output(addItemToFront)  # "StartingDistances:double[]"
distanceTo_2 = Geometry.DistanceTo(geometry=flatten, other=PointsofLocation)
addItemToEnd = List.AddItemToEnd(item=remainderofDistance, list=distanceTo_2)
EndingDistances = Output(addItemToEnd)  # "EndingDistances:double[]"
