# Dynamo custom node GetDurationofLevelsandCategoriesbyNumberperDay.dyf (Dynamo 2.2.1.5175)
# category: PracticalBIM.4dSimulation
# Gets the duration of Levels and Categories using the number of elements per day

LaborRateofCategory = Input(LaborRateofCategory: double[])
CategoryList = Input(CategoryList: int[])
LevelList = Input(LevelList: int[])
code_block = CodeBlock(a=CategoryList, b=LevelList) { a+"_"+b; }
groupByKey = List.GroupByKey(list=code_block, keys=code_block)
code_block_2 = CodeBlock { 0; }
code_block_3 = CodeBlock { 1; }
substring = String.Substring(str=groupByKey.groups, startIndex=code_block_2, length=code_block_3)
toNumber = String.ToNumber(str=substring)
code_block_4 = CodeBlock(a=toNumber) { a-1; }
getItemAtIndex = List.GetItemAtIndex(list=LaborRateofCategory, index=code_block_4)
sum = Math.Sum(values=getItemAtIndex)
TotaldurationofTasks = Output(sum)  # "TotaldurationofTasks:double[]"
CategoryandLevels = Output(groupByKey.unique_keys)  # "CategoryandLevels:string[]"
CategoryandLevelsTotals = Output(code_block)  # "CategoryandLevelsTotals:string[]"
