# Dynamo custom node GetFamilyInstancefromElement.dyf (Dynamo 2.2.1.5175)
# category: PracticalBIM.Revit.Elements.Element
# Gets the Family Instance from an Element

element = Input(element: Revit.Elements.Element[])
elementType = Element.ElementType(element=element)
uniqueItems = List.UniqueItems(list=elementType)
byFamilyType = FamilyInstance.ByFamilyType(familyType=uniqueItems)
flatten = List.Flatten(list=byFamilyType)
id = Element.Id(element=flatten)
id_2 = Element.Id(element=element)
allIndicesOf = List.AllIndicesOf(list=id, item=id_2)
flatten_2 = List.Flatten(list=allIndicesOf)
getItemAtIndex = List.GetItemAtIndex(list=flatten, index=flatten_2)
familyinstance = Output(getItemAtIndex)  # "familyinstance:FamilyInstance[]"
