# Dynamo custom node GetFamilybyCategoryandName.dyf (Dynamo 2.6.1.8786)
# category: PracticalBIM.Revit.Elements.Family
# Gets a family by Category and Name

SelectedCategory = Input(SelectedCategory: Revit.Elements.Category)
all_elements_of_category = ElementsOfCategory(Category=SelectedCategory)
code_block = CodeBlock { "Type"; }
getParameterValueByName = Element.GetParameterValueByName(element=all_elements_of_category, parameterName=code_block)
code_block_2 = CodeBlock { "Family Name"; }
getParameterValueByName_2 = Element.GetParameterValueByName(element=getParameterValueByName, parameterName=code_block_2)
FamilyName = Input(FamilyName: string)
allIndicesOf = List.AllIndicesOf(list=getParameterValueByName_2, item=FamilyName)
getItemAtIndex = List.GetItemAtIndex(list=all_elements_of_category, index=allIndicesOf)
SelectedElements = Output(getItemAtIndex)  # "SelectedElements:Element"
