# Dynamo custom node GetFourPointsbyXandY.dyf (Dynamo 2.3.0.5885)
# category: PracticalBIM.Geometry.Points
# Creates Four Points by Coordinate System X and Y

CoordinateSystems = Input(CoordinateSystems: Autodesk.DesignScript.Geometry.CoordinateSystem)
XValue = Input(XValue: double)
code_block = CodeBlock(a=XValue) { a/2; }
Yvalue = Input(Yvalue: double)
code_block_2 = CodeBlock(a=Yvalue) { a/2; }
byCartesianCoordinates = Point.ByCartesianCoordinates(cs=CoordinateSystems, x=code_block, y=code_block_2)
code_block_3 = CodeBlock(a=code_block_2) { a*-1; }
byCartesianCoordinates_2 = Point.ByCartesianCoordinates(cs=CoordinateSystems, x=code_block, y=code_block_3)
code_block_4 = CodeBlock(a=code_block) { a*-1; }
byCartesianCoordinates_3 = Point.ByCartesianCoordinates(cs=CoordinateSystems, x=code_block_4, y=code_block_2)
byCartesianCoordinates_4 = Point.ByCartesianCoordinates(cs=CoordinateSystems, x=code_block_4, y=code_block_3)
list_create = List.Create(item0=byCartesianCoordinates, item1=byCartesianCoordinates_2, item2=byCartesianCoordinates_3, item3=byCartesianCoordinates_4)
setofpoints = Output(list_create)  # "setofpoints:Point"
