# Dynamo custom node GetGridSystembyNPerpendicular.dyf (Dynamo 2.2.1.5175)
# category: PracticalBIM.Revit.Elements.MEP.Ducts
# Gets a Grid by a Number of Separations on Perpendicular

MechanicalPoint = Input(MechanicalPoint: Autodesk.DesignScript.Geometry.Point)
AirTerminalpoints = Input(AirTerminalpoints: Autodesk.DesignScript.Geometry.Point[])
X = Point.X(point=AirTerminalpoints)
Y = Point.Y(point=AirTerminalpoints)
Z = Point.Z(point=MechanicalPoint)
byCoordinates = Point.ByCoordinates(x=X, y=Y, z=Z, lacing=Longest)
byBestFitThroughPoints = Line.ByBestFitThroughPoints(bestFitPoints=byCoordinates)
closestPointTo = Geometry.ClosestPointTo(geometry=byBestFitThroughPoints, other=MechanicalPoint)
byTwoPoints = Vector.ByTwoPoints(start=MechanicalPoint, end=closestPointTo)
code_block = CodeBlock { 2; }
scale = Vector.Scale(vector=byTwoPoints, scale_factor=code_block)
add = Point.Add(point=MechanicalPoint, vectorToAdd=scale)
byStartPointEndPoint = Line.ByStartPointEndPoint(startPoint=MechanicalPoint, endPoint=add)
startPoint = Curve.StartPoint(curve=byBestFitThroughPoints)
byTwoPoints_2 = Vector.ByTwoPoints(start=closestPointTo, end=startPoint)
translate = Geometry.Translate(geometry=byStartPointEndPoint, direction=byTwoPoints_2)
Numberofseparations = Input(Numberofseparations: double)
code_block_2 = CodeBlock(a=Numberofseparations) { a+2; }
code_block_3 = CodeBlock(n=code_block_2) { 0..1..#n; }
restOfItems = List.RestOfItems(list=code_block_3)
removeLast = Custom[RemoveLast](list=restOfItems)  # Remove Last element of a List
pointAtParameter = Curve.PointAtParameter(curve=translate, param=removeLast, lacing=CrossProduct)
endPoint = Curve.EndPoint(curve=byBestFitThroughPoints)
byTwoPoints_3 = Vector.ByTwoPoints(start=closestPointTo, end=endPoint)
translate_2 = Geometry.Translate(geometry=byStartPointEndPoint, direction=byTwoPoints_3)
pointAtParameter_2 = Curve.PointAtParameter(curve=translate_2, param=removeLast, lacing=CrossProduct)
byStartPointEndPoint_2 = Line.ByStartPointEndPoint(startPoint=pointAtParameter, endPoint=pointAtParameter_2)
PerpendicularLines = Output(byStartPointEndPoint_2)  # "PerpendicularLines:Line[]"
flatten = List.Flatten(list=byStartPointEndPoint_2)
geometryFarObject = Custom[GeometryFarObject](geometry=flatten, other=MechanicalPoint)  # Gets the geometry Farest Object
closestPointTo_2 = Geometry.ClosestPointTo(geometry=geometryFarObject, other=MechanicalPoint)
byStartPointEndPoint_3 = Line.ByStartPointEndPoint(startPoint=MechanicalPoint, endPoint=closestPointTo_2)
ConnectingLine = Output(byStartPointEndPoint_3)  # "ConnectingLine:Line[]"
