# Dynamo custom node GetHigherLevelfromLevelwithHeight.dyf (Dynamo 2.6.1.8786)
# category: PracticalBIM.Revit.Elements.Levels
# Gets the Higher Level of a Level with their Heigth
# packages: PracticalBIM 2020.0.28

element_types = ElementTypes("Level")
all_elements_of_type = ElementsOfType(element_type=element_types)
restOfItems = List.RestOfItems(list=all_elements_of_type)
code_block = CodeBlock { "Name"; }
getParameterValueByName = Element.GetParameterValueByName(element=all_elements_of_type, parameterName=code_block)
removeLast = Custom[RemoveLast](list=getParameterValueByName)  # package PracticalBIM
LevelE = Input(LevelE: var[])
getParameterValueByName_2 = Element.GetParameterValueByName(element=LevelE, parameterName=code_block)
indexOf = List.IndexOf(list=removeLast, element=getParameterValueByName_2)
getItemAtIndex = List.GetItemAtIndex(list=restOfItems, index=indexOf)
levelValue = Output(getItemAtIndex)  # "levelValue:Level[]"
code_block_2 = CodeBlock { "Elevation"; }
getParameterValueByName_3 = Element.GetParameterValueByName(element=all_elements_of_type, parameterName=code_block_2)
restOfItems_2 = List.RestOfItems(list=getParameterValueByName_3)
getItemAtIndex_2 = List.GetItemAtIndex(list=restOfItems_2, index=indexOf)
heigthValue = Output(getItemAtIndex_2)  # "heigthValue:double"
