# Dynamo custom node GetHigherPosiblevalueandItsCombinations.dyf (Dynamo 2.3.0.5885)
# category: PracticalBIM.GD.Selection
# Gets the HIgher Posible Value and Its Combinations

indexes = Input(indexes: double[]..[])
required = Input(required: double[])
values = Input(values: double[])
ge = required >= values  # lacing=CrossProduct
code_block = CodeBlock { true; }
allIndicesOf = List.AllIndicesOf(list=ge@L2, item=code_block)
lastItem = List.LastItem(list=allIndicesOf@L2)
getItemAtIndex = List.GetItemAtIndex(list=indexes, index=lastItem)
itemcombinations = Output(getItemAtIndex)  # "itemcombinations:var"
getItemAtIndex_2 = List.GetItemAtIndex(list=values, index=lastItem)
values_2 = Output(getItemAtIndex_2)  # "values:double"
