# Dynamo custom node GetHorizontalVerticalandOtherElements.dyf (Dynamo 2.2.1.5175)
# category: PracticalBIM.Revit.Elements.Orientation
# Gets from a list of line based elements if they are horizontal vertical or other oriented

elements = Input(elements: Revit.Elements.Element[])
getLocation = Element.GetLocation(element=elements)
startPoint = Curve.StartPoint(curve=getLocation)
X = Point.X(point=startPoint)
endPoint = Curve.EndPoint(curve=getLocation)
X_2 = Point.X(point=endPoint)
eq = X == X_2
filterByBoolMask = List.FilterByBoolMask(list=elements, mask=eq)
VerticalElements = Output(filterByBoolMask.in)
getLocation_2 = Element.GetLocation(element=filterByBoolMask.out)
startPoint_2 = Curve.StartPoint(curve=getLocation_2)
Y = Point.Y(point=startPoint_2)
endPoint_2 = Curve.EndPoint(curve=getLocation_2)
Y_2 = Point.Y(point=endPoint_2)
eq_2 = Y == Y_2
filterByBoolMask_2 = List.FilterByBoolMask(list=filterByBoolMask.out, mask=eq_2)
HorizontalElements = Output(filterByBoolMask_2.in)
OtherElements = Output(filterByBoolMask_2.out)
