# Dynamo custom node GetHorizontalVerticalandOtherLines.dyf (Dynamo 2.2.1.5175)
# category: PracticalBIM.Geometry.Curves
# Separates the Lines that are horizonal from the vertical and the other types of orientation lines

curves = Input(curves: Autodesk.DesignScript.Geometry.Curve[])
startPoint = Curve.StartPoint(curve=curves)
X = Point.X(point=startPoint)
endPoint = Curve.EndPoint(curve=curves)
X_2 = Point.X(point=endPoint)
eq = X == X_2
filterByBoolMask = List.FilterByBoolMask(list=curves, mask=eq)
VerticalLines = Output(filterByBoolMask.in)  # "VerticalLines:Line[]"
startPoint_2 = Curve.StartPoint(curve=filterByBoolMask.out)
Y = Point.Y(point=startPoint_2)
endPoint_2 = Curve.EndPoint(curve=filterByBoolMask.out)
Y_2 = Point.Y(point=endPoint_2)
eq_2 = Y == Y_2
filterByBoolMask_2 = List.FilterByBoolMask(list=filterByBoolMask.out, mask=eq_2)
HorizontalLines = Output(filterByBoolMask_2.in)  # "HorizontalLines:Line[]"
OtherLines = Output(filterByBoolMask_2.out)  # "OtherLines:Line[]"
