# Dynamo custom node GetLinesAndVectorOrientedtoanElement.dyf (Dynamo 2.6.1.8786)
# category: PracticalBIM.Geometry.Transfer
# Gets the Lines and Vectors Oriented to an Element such as Floor or Framing

framingfloorelement = Input(framingfloorelement: Revit.Elements.Element)
getLocation = Element.GetLocation(element=framingfloorelement)
isNull = Object.IsNull(obj=getLocation)
sketchelement = Input(sketchelement: Revit.Elements.Element[])
geometry = Element.Geometry(element=sketchelement)
lastItem = List.LastItem(list=geometry@L2)
startPoint = Curve.StartPoint(curve=lastItem)
startPoint_2 = Curve.StartPoint(curve=getLocation)
closestPointTo = Geometry.ClosestPointTo(geometry=getLocation, other=startPoint)
distanceTo = Geometry.DistanceTo(geometry=startPoint_2, other=closestPointTo)
endPoint = Curve.EndPoint(curve=lastItem)
closestPointTo_2 = Geometry.ClosestPointTo(geometry=getLocation, other=endPoint)
distanceTo_2 = Geometry.DistanceTo(geometry=startPoint_2, other=closestPointTo_2)
lt = distanceTo < distanceTo_2
if_ = If(test=lt, true=startPoint, false=endPoint)
startPoint_3 = If(test=isNull, true=startPoint, false=if_)
gt = distanceTo > distanceTo_2
if_2 = If(test=gt, true=startPoint, false=endPoint)
endPoint_2 = If(test=isNull, true=endPoint, false=if_2)
byTwoPoints = Vector.ByTwoPoints(start=startPoint_3, end=endPoint_2)
vector = Output(byTwoPoints)  # "vector: Vector"
startpoint = Output(startPoint_3)  # "startpoint: Point"
endpoint = Output(endPoint_2)  # "endpoint: Point"
