# Dynamo custom node GetListofSelectedValueswithRange.dyf (Dynamo 2.3.0.5885)
# category: PracticalBIM.GD.Selection.Items
# Gets a List of the Selected Values on the range by Items List

listofselector = Input(listofselector: var[]..[])
max = Input(max: double[])
values = Input(values: double[])
min = Input(min: double[])
gt = min > values
code_block = CodeBlock { true; }
allIndicesOf = List.AllIndicesOf(list=gt@L2, item=code_block)
getItemAtIndex = List.GetItemAtIndex(list=values@L2, index=allIndicesOf@L2)
lt = max < getItemAtIndex
code_block_2 = CodeBlock { true; }
allIndicesOf_2 = List.AllIndicesOf(list=lt@L2, item=code_block_2)
getItemAtIndex_2 = List.GetItemAtIndex(list=listofselector@L3, index=allIndicesOf_2@L2)
items = Output(getItemAtIndex_2)  # "items:var[]..[]"
