# Dynamo custom node GetLowerLevelfromLevelwithHeight.dyf (Dynamo 2.2.1.5175)
# category: PracticalBIM.Revit.Elements.Levels
# Get Lower Level from Level with Height

element_types = ElementTypes("Level")
all_elements_of_type = ElementsOfType(element_type=element_types)
code_block = CodeBlock { "Elevation"; }
getParameterValueByName = Element.GetParameterValueByName(element=all_elements_of_type, parameterName=code_block)
restOfItems = List.RestOfItems(list=getParameterValueByName)
removeLast = Custom[RemoveLast](list=getParameterValueByName)  # Remove Last element of a List
code_block_2 = CodeBlock(a=restOfItems, b=removeLast) { a-b; }
code_block_3 = CodeBlock { "Name"; }
getParameterValueByName_2 = Element.GetParameterValueByName(element=all_elements_of_type, parameterName=code_block_3)
restOfItems_2 = List.RestOfItems(list=getParameterValueByName_2)
element = Input(element: Revit.Elements.Element[])
code_block_4 = CodeBlock { "Name"; }
getParameterValueByName_3 = Element.GetParameterValueByName(element=element, parameterName=code_block_4)
indexOf = List.IndexOf(list=restOfItems_2, element=getParameterValueByName_3)
getItemAtIndex = List.GetItemAtIndex(list=removeLast, index=indexOf)
heigthValue = Output(getItemAtIndex)  # "heigthValue:double[]"
removeLast_2 = Custom[RemoveLast](list=all_elements_of_type)
getItemAtIndex_2 = List.GetItemAtIndex(list=removeLast_2, index=indexOf)
levelValue = Output(getItemAtIndex_2)  # "levelValue:Level[]"
