# Dynamo custom node GetLowerSurfacesfromaSolid.dyf (Dynamo 2.2.1.5175)
# category: PracticalBIM.Geometry.Solids
# Gets the Lower Surface from a Solid

topology = Input(topology: Autodesk.DesignScript.Geometry.Topology[])
faces = Topology.Faces(topology=topology)
surfaceGeometry = Face.SurfaceGeometry(face=faces)
code_block = CodeBlock { 1; }
flatten = List.Flatten(list=surfaceGeometry@L2, amt=code_block)
code_block_2 = CodeBlock { 0.5; }
normalAtParameter = Surface.NormalAtParameter(surface=flatten, u=code_block_2, v=code_block_2)
Z = Vector.Z(vector=normalAtParameter)
code_block_3 = CodeBlock { -1; }
eq = Z == code_block_3
code_block_4 = CodeBlock { true; }
indexOf = List.IndexOf(list=eq@L2, element=code_block_4)
getItemAtIndex = List.GetItemAtIndex(list=flatten, index=indexOf, lacing=Shortest)
Surfaces = Output(getItemAtIndex)  # "Surfaces[]..[]"
