# Dynamo custom node GetLowerZSolidfromSplit.dyf (Dynamo 2.2.1.5175)
# category: PracticalBIM.Geometry.Solids
# Get the Lower Z Volume from centroid from a Split

inverse = Input(inverse: bool)
solid = Input(solid: Autodesk.DesignScript.Geometry.Solid[])
centroid = Solid.Centroid(solid=solid)
Z = Point.Z(point=centroid)
code_block = CodeBlock { 0; }
getItemAtIndex = List.GetItemAtIndex(list=Z@L2, index=code_block)
code_block_2 = CodeBlock { 1; }
getItemAtIndex_2 = List.GetItemAtIndex(list=Z@L2, index=code_block_2)
gt = getItemAtIndex > getItemAtIndex_2
if_ = If(test=gt, true=code_block, false=code_block_2)
if_2 = If(test=gt, true=code_block_2, false=code_block)
if_3 = If(test=inverse, true=if_, false=if_2)
resultingsolids = Output(if_3)  # "resultingsolids:Solid[]"
