# Dynamo custom node GetLowerandBiggerSideSurfacesfromaSolid.dyf (Dynamo 2.2.1.5175)
# category: PracticalBIM.Geometry.Solids
# Gets Lower and Bigger Side Surfaces from a Solid

solidstobeused = Input(solidstobeused: Autodesk.DesignScript.Geometry.Topology[]..[])
faces = Topology.Faces(topology=solidstobeused)
surfaceGeometry = Face.SurfaceGeometry(face=faces)
code_block = CodeBlock { 0.5; }
normalAtParameter = Surface.NormalAtParameter(surface=surfaceGeometry, u=code_block, v=code_block)
Z = Vector.Z(vector=normalAtParameter)
code_block_2 = CodeBlock { 1; }
eq = Z == code_block_2
code_block_3 = CodeBlock { true; }
allIndicesOf = List.AllIndicesOf(list=eq@L2, item=code_block_3)
removeItemAtIndex = List.RemoveItemAtIndex(list=surfaceGeometry@L2, indices=allIndicesOf@L2)
area = Surface.Area(surface=removeItemAtIndex)
code_block_4 = CodeBlock { 2; }
round = Math.Round(number=area, digits=code_block_4)
minimumItem = List.MinimumItem(list=round@L2)
allIndicesOf_2 = List.AllIndicesOf(list=round, item=minimumItem)
removeItemAtIndex_2 = List.RemoveItemAtIndex(list=removeItemAtIndex@L2, indices=allIndicesOf_2@L2)
ResultingSurfaces = Output(removeItemAtIndex_2)  # "ResultingSurfaces:Surface[]..[]"
