# Dynamo custom node GetOrientationVectorsFromPointsandCurveMid.dyf (Dynamo 2.2.1.5175)
# category: PracticalBIM.Geometry.Abstract.Vector
# Get the Orientation Vectors From Points and a Curve Starting and Ending not from first and last points of a Curve

curve = Input(curve: Autodesk.DesignScript.Geometry.Curve)
points = Input(points: Autodesk.DesignScript.Geometry.Point[])
splitByPoints = Curve.SplitByPoints(curve=curve, points=points)
code_block = CodeBlock { 0.5; }
pointAtParameter = Curve.PointAtParameter(curve=splitByPoints, param=code_block)
removeLast = Custom[RemoveLast](list=pointAtParameter)  # Remove Last element of a List
restOfItems = List.RestOfItems(list=pointAtParameter)
byStartPointEndPoint = Line.ByStartPointEndPoint(startPoint=removeLast, endPoint=restOfItems)
direction = Line.Direction(line=byStartPointEndPoint)
Vector = Output(direction)  # "Vector[]"
