# Dynamo custom node GetOrientationVectorsFromPointsandCurvesSE.dyf (Dynamo 2.2.1.5175)
# category: PracticalBIM.Geometry.Abstract.Vector
# Get all orientation vectors and Points from a Line from start to end

points = Input(points: Autodesk.DesignScript.Geometry.Point[])
firstItem = List.FirstItem(list=points)
curve = Input(curve: Autodesk.DesignScript.Geometry.Curve[])
splitByPoints = Curve.SplitByPoints(curve=curve, points=points)
code_block = CodeBlock { 0.5; }
pointAtParameter = Curve.PointAtParameter(curve=splitByPoints, param=code_block, lacing=Longest)
flatten = List.Flatten(list=pointAtParameter)
addItemToFront = List.AddItemToFront(item=firstItem, list=flatten)
lastItem = List.LastItem(list=points)
addItemToEnd = List.AddItemToEnd(item=lastItem, list=flatten)
byStartPointEndPoint = Line.ByStartPointEndPoint(startPoint=addItemToFront, endPoint=addItemToEnd)
direction = Line.Direction(line=byStartPointEndPoint)
Vector = Output(direction)  # "Vector[]"
