# Dynamo custom node GetProjectedPointonaCurvewithVector.dyf (Dynamo 2.3.0.5885)
# category: PracticalBIM.Geometry.Points
# Gets the projected point over a Curve by Plane and gives also the vector

geometrytoproject = Input(geometrytoproject: Autodesk.DesignScript.Geometry.Geometry[])
PointtoProject = Input(PointtoProject: Autodesk.DesignScript.Geometry.Point[])
linevectorofpoint = Input(linevectorofpoint: Autodesk.DesignScript.Geometry.Vector[])
byOriginNormal = Plane.ByOriginNormal(origin=PointtoProject, normal=linevectorofpoint)
intersect = Geometry.Intersect(geometry=geometrytoproject, other=byOriginNormal)
flatten = List.Flatten(list=intersect)
ProjectedPoints = Output(flatten)  # "ProjectedPoints:Point"
code_block = CodeBlock { 0.2; }
translate = Geometry.Translate(geometry=PointtoProject, direction=linevectorofpoint, distance=code_block)
byOriginNormal_2 = Plane.ByOriginNormal(origin=translate, normal=linevectorofpoint)
intersect_2 = Geometry.Intersect(geometry=geometrytoproject, other=byOriginNormal_2)
flatten_2 = List.Flatten(list=intersect_2)
byTwoPoints = Vector.ByTwoPoints(start=flatten, end=flatten_2)
vectors = Output(byTwoPoints)  # "vectors:Vector"
