# Dynamo custom node GetProjectionDirectionZfromTwoPoints.dyf (Dynamo 2.3.0.5885)
# category: PracticalBIM.Geometry.Abstract.Vector
# Gets the Projection Direction of Z by using two Points

point = Input(point: Autodesk.DesignScript.Geometry.Point)
Z = Point.Z(point=point)
point_2 = Input(point: Autodesk.DesignScript.Geometry.Point)
Z_2 = Point.Z(point=point_2)
gt = Z > Z_2
code_block = CodeBlock { -1; }
byCoordinates = Vector.ByCoordinates(z=code_block)
code_block_2 = CodeBlock { 1; }
byCoordinates_2 = Vector.ByCoordinates(z=code_block_2)
if_ = If(test=gt, true=byCoordinates, false=byCoordinates_2)
vector = Output(if_)  # "vector:Vector"
