# Dynamo custom node GetSideSurfacesfromaSolid.dyf (Dynamo 2.2.1.5175)
# category: PracticalBIM.Geometry.Solids
# Gets the Side Surfaces from a Solid

solidstobeused = Input(solidstobeused: Autodesk.DesignScript.Geometry.Topology[]..[])
faces = Topology.Faces(topology=solidstobeused)
surfaceGeometry = Face.SurfaceGeometry(face=faces)
code_block = CodeBlock { 0.5; }
normalAtParameter = Surface.NormalAtParameter(surface=surfaceGeometry, u=code_block, v=code_block)
Z = Vector.Z(vector=normalAtParameter)
code_block_2 = CodeBlock { 1; }
eq = Z == code_block_2
code_block_3 = CodeBlock { true; }
allIndicesOf = List.AllIndicesOf(list=eq@L2, item=code_block_3)
removeItemAtIndex = List.RemoveItemAtIndex(list=surfaceGeometry@L2, indices=allIndicesOf@L2)
code_block_4 = CodeBlock { 0.5; }
normalAtParameter_2 = Surface.NormalAtParameter(surface=removeItemAtIndex, u=code_block_4, v=code_block_4)
Z_2 = Vector.Z(vector=normalAtParameter_2)
code_block_5 = CodeBlock { -1; }
eq_2 = Z_2 == code_block_5
code_block_6 = CodeBlock { true; }
allIndicesOf_2 = List.AllIndicesOf(list=eq_2@L2, item=code_block_6)
removeItemAtIndex_2 = List.RemoveItemAtIndex(list=removeItemAtIndex@L2, indices=allIndicesOf_2@L2)
ResultingSurfaces = Output(removeItemAtIndex_2)  # "ResultingSurfaces:Surface[]..[]"
