# Dynamo custom node GetSortedFamilyTypesofFamilybyfamilyName.dyf (Dynamo 2.3.0.5885)
# category: PracticalBIM.Revit.Elements.Family
# Get Sorted all family Types from a Family by Family Name

FamilyName = Input(FamilyName: string)
byName = Family.ByName(name=FamilyName)
types = Family.Types(family=byName)
name = Element.Name(element=types)
sort = List.Sort(list=name)
indexOf = List.IndexOf(list=name, element=sort)
getItemAtIndex = List.GetItemAtIndex(list=types, index=indexOf)
FamilyTypes = Output(getItemAtIndex)  # "FamilyTypes:Element"
TypeNames = Output(sort)  # "TypeNames:String"
