# Dynamo custom node GetStartingPrecedencebyCategory.dyf (Dynamo 2.2.1.5175)
# category: PracticalBIM.4dSimulation
# Gets the Starting Precedence of Dates by category elements

TotalDurationofTasks = Input(TotalDurationofTasks: double[])
CategoryandLevel = Input(CategoryandLevel: string[])
code_block = CodeBlock { 0; }
code_block_2 = CodeBlock { "_"; }
indexOf = String.IndexOf(str=CategoryandLevel, searchFor=code_block_2)
substring = String.Substring(str=CategoryandLevel, startIndex=code_block, length=indexOf)
groupByKey = List.GroupByKey(list=TotalDurationofTasks, keys=substring)
groupByKey_2 = List.GroupByKey(list=CategoryandLevel, keys=substring)
count = List.Count(list=groupByKey_2.groups@L2)
code_block_3 = CodeBlock(a=count) { 0..a-1..1; }
code_block_4 = CodeBlock(a=code_block_3) { 0..a..1; }
getItemAtIndex = List.GetItemAtIndex(list=groupByKey.groups@L2, index=code_block_4@L3)
sum = Math.Sum(values=getItemAtIndex@L2)
flatten = List.Flatten(list=groupByKey.groups)
code_block_5 = CodeBlock(a=sum, b=flatten) { a-b; }
StartDays = Output(code_block_5)  # "StartDays:double[]"
