# Dynamo custom node GetUnusedandReferencedElementsFromFamilyandCategory.dyf (Dynamo 2.3.0.5885)
# category: PracticalBIM.Revit.Elements.Family
# Gets the Unused and Referenced Elements From Family and Category
# packages: PracticalBIM 2020.0.35

SelectedCategory = Input(SelectedCategory: Revit.Elements.Category)
FamilyName = Input(FamilyName: string)
getFamilybyCategoryandName = Custom[GetFamilybyCategoryandName](SelectedCategory=SelectedCategory, FamilyName=FamilyName)  # package PracticalBIM; Gets a family by Category and Name
code_block = CodeBlock { "Used"; }
code_block_2 = CodeBlock { 0; }
filterElementsbyParameterandValue = Custom[FilterElementsbyParameterandValue](element=getFamilybyCategoryandName, parameterName=code_block, FilterValue=code_block_2)  # package PracticalBIM; Filters all Elements by Parameter and value
code_block_3 = CodeBlock { "Reference"; }
getParameterValueByName = Element.GetParameterValueByName(element=filterElementsbyParameterandValue, parameterName=code_block_3)
SElementId = Input(SElementId: int[])
allIndicesOf = List.AllIndicesOf(list=getParameterValueByName, item=SElementId)
getItemAtIndex = List.GetItemAtIndex(list=filterElementsbyParameterandValue, index=allIndicesOf)
PElements = Output(getItemAtIndex)  # "PElements:Elements"
