# Dynamo custom node GetVerticalDistanceValuefromSchedulesTwoIndexes.dyf (Dynamo 2.2.1.5175)
# category: PracticalBIM.Revit.View.Schedules
# Gets the Vertical Distance Values from Schedules by two indexes from a schedule view

code_block = CodeBlock { 0; }
scheduleView = Input(scheduleView: Revit.Elements.Views.ScheduleView[])
columnIndex1 = Input(columnIndex1: int)
code_block_2 = CodeBlock { true; }
getDataColumns = Revit.Schedule.GetDataColumns(scheduleView=scheduleView, columnIndex=columnIndex1, removeHeading=code_block_2)
uniqueItems = List.UniqueItems(list=getDataColumns@L2)
count = List.Count(list=uniqueItems@L2)
columnIndex2 = Input(columnIndex2: int)
getDataColumns_2 = Revit.Schedule.GetDataColumns(scheduleView=scheduleView, columnIndex=columnIndex2, removeHeading=code_block_2)
uniqueItems_2 = List.UniqueItems(list=getDataColumns_2@L2)
count_2 = List.Count(list=uniqueItems_2@L2)
code_block_3 = CodeBlock(a=count, b=count_2) { (a*b)+2; }
separationDistance = Input(separationDistance: double)
code_block_4 = CodeBlock(a=code_block_3, b=separationDistance) { -a*b; }
addItemToFront = List.AddItemToFront(item=code_block, list=code_block_4)
count_3 = List.Count(list=addItemToFront)
code_block_5 = CodeBlock(a=count_3) { 1..#a..1; }
code_block_6 = CodeBlock(a=code_block_5) { 0..#a..1; }
getItemAtIndex = List.GetItemAtIndex(list=addItemToFront, index=code_block_6)
sum = Math.Sum(values=getItemAtIndex)
removeLast = Custom[RemoveLast](list=sum)  # Remove Last element of a List
list = Output(removeLast)
