# Dynamo custom node GetZValuefromIndexesValuesandPointsZ.dyf (Dynamo 2.2.1.5175)
# category: PracticalBIM.Revit.Elements.SoilMechanics
# Gets the List of Z Values using its Point Z and the Average Factor of Distance

PointzValuesOfAllPoints = Input(PointzValuesOfAllPoints: double[]..[])
Number1Index = Input(Number1Index: int[])
getItemAtIndex = List.GetItemAtIndex(list=PointzValuesOfAllPoints@L2, index=Number1Index)
Number1Factor = Input(Number1Factor: double[])
mul = getItemAtIndex@L2 * Number1Factor
Number2Index = Input(Number2Index: int[])
getItemAtIndex_2 = List.GetItemAtIndex(list=PointzValuesOfAllPoints@L2, index=Number2Index)
Number2Factor = Input(Number2Factor: double[])
mul_2 = getItemAtIndex_2@L2 * Number2Factor
Number3Index = Input(Number3Index: int[])
getItemAtIndex_3 = List.GetItemAtIndex(list=PointzValuesOfAllPoints@L2, index=Number3Index)
Number3Factor = Input(Number3Factor: double[])
mul_3 = getItemAtIndex_3@L2 * Number3Factor
code_block = CodeBlock(a=mul, b=mul_2, c=mul_3) { a+b+c; }
PointZArray = Output(code_block)  # "PointZArray:double[]"
