# Dynamo custom node GridCombinationNames.dyf (Dynamo 2.2.1.5175)
# category: PracticalBIM.4dSimulation
# Gets the Grid Combination Names for Block of Zone

list = Input(list: string[])
lastItem = List.LastItem(list=list)
firstItem = List.FirstItem(list=list)
code_block = CodeBlock { 1; }
shiftIndices = List.ShiftIndices(list=list, amount=code_block)
restOfItems = List.RestOfItems(list=shiftIndices)
restOfItems_2 = List.RestOfItems(list=list)
code_block_2 = CodeBlock(a=restOfItems, b=restOfItems_2) { a+"/"+b; }
addItemToFront = List.AddItemToFront(item=firstItem, list=code_block_2)
addItemToEnd = List.AddItemToEnd(item=lastItem, list=addItemToFront)
resultinglist = Output(addItemToEnd)  # "resultinglist:string[]"
