# Dynamo custom node GridPlanesforSlicing.dyf (Dynamo 2.2.1.5175)
# category: PracticalBIM.Geometry
# Creates Planes from Grids for a Slicing

element_types = ElementTypes("Grid")
all_elements_of_type = ElementsOfType(element_type=element_types)
curve = Grid.Curve(grid=all_elements_of_type)
code_block = CodeBlock { 0.5; }
pointAtParameter = Curve.PointAtParameter(curve=curve, param=code_block)
code_block_2 = CodeBlock { 2; }
byCoordinates = Vector.ByCoordinates(z=code_block_2)
translate = Geometry.Translate(geometry=pointAtParameter, direction=byCoordinates)
byLineAndPoint = Plane.ByLineAndPoint(line=curve, point=translate)
direction = Line.Direction(line=curve)
normalized = Vector.Normalized(vector=direction)
string_from_object = FromObject(obj=normalized)
uniqueItems = List.UniqueItems(list=string_from_object)
allIndicesOf = List.AllIndicesOf(list=string_from_object, item=uniqueItems)
getItemAtIndex = List.GetItemAtIndex(list=byLineAndPoint, index=allIndicesOf)
code_block_3 = CodeBlock { 0; }
getItemAtIndex_2 = List.GetItemAtIndex(list=getItemAtIndex, index=code_block_3)
verticalgridplanes = Output(getItemAtIndex_2)  # "verticalgridplanes:Plane[]"
code_block_4 = CodeBlock { 1; }
getItemAtIndex_3 = List.GetItemAtIndex(list=getItemAtIndex, index=code_block_4)
Horizontalgridplanes = Output(getItemAtIndex_3)  # "Horizontalgridplanes:Plane[]"
