# Dynamo custom node GridSplitMainLinefromintersects.dyf (Dynamo 2.2.1.5175)
# category: PracticalBIM.Revit.Elements.MEP.RoutingGrids
# Split main line by intersection Points

MainLine = Input(MainLine: Autodesk.DesignScript.Geometry.Curve[])
otherLines = Input(otherLines: Autodesk.DesignScript.Geometry.Curve[])
intersect = Geometry.Intersect(geometry=MainLine, other=otherLines, lacing=Longest)
flatten = List.Flatten(list=intersect)
splitByPoints = Curve.SplitByPoints(curve=MainLine, points=flatten)
flatten_2 = List.Flatten(list=splitByPoints)
SplittedLines = Output(flatten_2)  # "SplittedLines:Autodesk.Geometry.Curve[]"
