# Dynamo custom node GroupMultipleLinesbyParalellIntersectionofPlanes.dyf (Dynamo 2.6.1.8786)
# category: PracticalBIM.Geometry.Curves
# Group Multiple Lines by Paralell Intersection of Planes
# packages: PracticalBIM 2020.0.32

MultipleCurves = Input(MultipleCurves: Autodesk.DesignScript.Geometry.Curve[])
curvetoLine = Custom[CurvetoLine](curve=MultipleCurves)  # package PracticalBIM; Transform a Curve to a Line by StartPoint EndPoint
code_block = CodeBlock { 0.5; }
pointAtParameter = Curve.PointAtParameter(curve=MultipleCurves, param=code_block)
code_block_2 = CodeBlock { 1; }
byCoordinates = Vector.ByCoordinates(z=code_block_2)
translate = Geometry.Translate(geometry=pointAtParameter, direction=byCoordinates)
byLineAndPoint = Plane.ByLineAndPoint(line=curvetoLine, point=translate)
doesIntersect = Geometry.DoesIntersect(geometry=byLineAndPoint, other=curvetoLine, lacing=CrossProduct)
code_block_3 = CodeBlock { true; }
allIndicesOf = List.AllIndicesOf(list=doesIntersect@L2, item=code_block_3)
getItemAtIndex = List.GetItemAtIndex(list=curvetoLine, index=allIndicesOf)
intersect = Geometry.Intersect(geometry=byLineAndPoint, other=getItemAtIndex)
code_block_4 = CodeBlock { 1; }
flatten = List.Flatten(list=intersect@L3, amt=code_block_4)
type = Object.Type(obj=flatten)
code_block_5 = CodeBlock { "Autodesk.DesignScript.Geometry.Line"; }
eq = type == code_block_5
code_block_6 = CodeBlock { true; }
allIndicesOf_2 = List.AllIndicesOf(list=eq@L2, item=code_block_6)
getItemAtIndex_2 = List.GetItemAtIndex(list=flatten@L2, index=allIndicesOf_2@L2)
code_block_7 = CodeBlock { "_"; }
code_block_8 = CodeBlock { 0.5; }
pointAtParameter_2 = Curve.PointAtParameter(curve=getItemAtIndex_2, param=code_block_8)
string_from_object = FromObject(obj=pointAtParameter_2)
join = String.Join(separator=code_block_7, string0=string_from_object)
flatten_2 = List.Flatten(list=join)
uniqueItems = List.UniqueItems(list=flatten_2)
firstIndexOf = List.FirstIndexOf(list=flatten_2, item=uniqueItems)
getItemAtIndex_3 = List.GetItemAtIndex(list=getItemAtIndex_2, index=firstIndexOf)
GroupedLines = Output(getItemAtIndex_3)  # "GroupedLines:Line"
