# Dynamo custom node HigherZwithXYLowerPoint.dyf (Dynamo 2.2.1.5175)
# category: PracticalBIM.Geometry.Points
# Creates a Higher Point using the Coordinates of Ending Points

LowerCurve = Input(LowerCurve: Autodesk.DesignScript.Geometry.Curve)
endPoint = Curve.EndPoint(curve=LowerCurve)
OriginalStartPoint = Output(endPoint)  # "OriginalStartPoint:Point"
HigherCurve = Input(HigherCurve: Autodesk.DesignScript.Geometry.Curve)
startPoint = Curve.StartPoint(curve=HigherCurve)
OriginalEndPoint = Output(startPoint)  # "OriginalEndPoint:Point[]"
X = Point.X(point=endPoint)
Y = Point.Y(point=endPoint)
Z = Point.Z(point=startPoint)
byCoordinates = Point.ByCoordinates(x=X, y=Y, z=Z)
LowerPoint = Output(byCoordinates)  # "LowerPoint:Point[]"
