# Dynamo custom node IndexFromMapping.dyf (Dynamo 1.3.2.2480)
# category: PracticalBIM.Analysis
# Use two lists to get their index from

x = Input(x : var[]..[])
y = Input(y : var[]..[])
eq = x == y  # lacing=CrossProduct
boolean = BoolSelector(true)
indexOf = IndexOf(arg1=boolean)  # unwired: arg0
map = List.Map(list=eq, f_x=indexOf)
mapped = Output(map)
