# Dynamo custom node InternalUnittoDisplayUnit.dyf (Dynamo 2.3.0.5885)
# category: PracticalBIM.Units
# Changes Internal Units to Display Units
# packages: Clockwork for Dynamo 2.x 2.3.0

val = Input(val: double)
turn_into_list = Custom[Turn Into List](unknownItem=val)  # package Clockwork for Dynamo 2.x; Turns an element (or a nested list) into a flat list
displayUnitType = Input(displayUnitType: var[]..[])
python_script = Python(IN[0]=turn_into_list, IN[1]=displayUnitType)
# ---------- python_script.python (10 lines) ----------
import clr
clr.AddReference('RevitAPI')
from Autodesk.Revit.DB import *

vals = IN[0]
dispunit = IN[1]
elementlist = []
for val in vals:
	elementlist.append(UnitUtils.ConvertFromInternalUnits(val,dispunit))
OUT = elementlist
# ----------------------------------------
returnListOrSingleValue = Custom[ReturnListOrSingleValue](unknownItem=val, seq=python_script)  # package Clockwork for Dynamo 2.x; If the unknown item is not a list but rather a single item, only the first item of the list (input "seq") will be returned.
val_2 = Output(returnListOrSingleValue)  # "val"
