# Dynamo custom node LabelingNumberofElements.dyf (Dynamo 2.2.1.5175)
# category: PracticalBIM.Lists
# Creates Labels From a Number of Elements

LabelStartText = Input(LabelStartText: string)
list = Input(list: var[])
count = List.Count(list=list)
code_block = CodeBlock(b=count) { 1..b..1; }
code_block_2 = CodeBlock(b=LabelStartText, a=code_block) { b+a; }
Labeled = Output(code_block_2)  # "Labeled:string[]"
