# Dynamo custom node Laticebysurfaceandcentroid.dyf (Dynamo 2.2.1.5175)
# category: PracticalBIM.Geometry.Abstract.Topology
# Creates a latice by Solid on Surface Faces

solid = Input(solid: Autodesk.DesignScript.Geometry.Solid)
faces = Topology.Faces(topology=solid)
surfaceGeometry = Face.SurfaceGeometry(face=faces)
code_block = CodeBlock { 0.5; }
pointAtParameter = Surface.PointAtParameter(surface=surfaceGeometry, u=code_block, v=code_block)
perimeterCurves = Surface.PerimeterCurves(surface=surfaceGeometry)
pointAtParameter_2 = Curve.PointAtParameter(curve=perimeterCurves, param=code_block, lacing=Longest)
byStartPointEndPoint = Line.ByStartPointEndPoint(startPoint=pointAtParameter, endPoint=pointAtParameter_2)
flatten = List.Flatten(list=byStartPointEndPoint)
code_block_2 = CodeBlock { [0,1]; }
planeAtParameter = Curve.PlaneAtParameter(curve=flatten, param=code_block_2, lacing=CrossProduct)
radius = Input(radius: double)
byPlaneRadius = Circle.ByPlaneRadius(plane=planeAtParameter, radius=radius)
byLoft = Solid.ByLoft(crossSections=byPlaneRadius)
Solid = Output(byLoft)
Line = Output(flatten)
