# Dynamo custom node Limitnumberofelementsinlist.dyf (Dynamo 2.2.1.5175)
# category: PracticalBIM.Lists.Match
# Limits the number of elements in a given list

list = Input(list: var[]..[])
count = List.Count(list=list@L2)
numberofelements = Input(numberofelements: int)
eq = count == numberofelements
code_block = CodeBlock { false; }
allIndicesOf = List.AllIndicesOf(list=eq, item=code_block)
removeItemAtIndex = List.RemoveItemAtIndex(list=list, indices=allIndicesOf)
list_2 = Output(removeItemAtIndex)  # "list[]..[]"
