# Dynamo custom node LineIntersectedwithLevelsandmovebydistanceandtranslateageometry.dyf (Dynamo 2.2.1.5175)
# category: PracticalBIM.Rebar.Geometry
# Move geometry from location to its intersections with levels with and offset

closedCurve = Input(closedCurve: Autodesk.DesignScript.Geometry.Curve[])
byPatch = Surface.ByPatch(closedCurve=closedCurve)
code_block = CodeBlock { 0.5; }
pointAtParameter = Surface.PointAtParameter(surface=byPatch, u=code_block, v=code_block)
curvetobeintersected = Input(curvetobeintersected: Autodesk.DesignScript.Geometry.Curve[])
endPoint = Curve.EndPoint(curve=curvetobeintersected)
XY = Plane.XY()
element_types = ElementTypes("Level")
all_elements_of_type = ElementsOfType(element_type=element_types)
elevation = Level.Elevation(level=all_elements_of_type)
byCoordinates = Vector.ByCoordinates(z=elevation)
translate = Geometry.Translate(geometry=XY, direction=byCoordinates)
intersect = Geometry.Intersect(geometry=curvetobeintersected, other=translate, lacing=CrossProduct)
flatten = List.Flatten(list=intersect)
addItemToEnd = List.AddItemToEnd(item=endPoint, list=flatten)
flatten_2 = List.Flatten(list=addItemToEnd)
offset = Input(offset: double)
byCoordinates_2 = Vector.ByCoordinates(z=offset)
translate_2 = Geometry.Translate(geometry=flatten_2, direction=byCoordinates_2)
byTwoPoints = Vector.ByTwoPoints(start=pointAtParameter, end=translate_2, lacing=Longest)
translate_3 = Geometry.Translate(geometry=closedCurve, direction=byTwoPoints, lacing=Longest)
Geometry = Output(translate_3)  # "Geometry[]"
