# Dynamo custom node LinesFromListofPoints.dyf (Dynamo 2.2.1.5175)
# category: PracticalBIM.Geometry.Curves
# Gets a secuence of Lines from a list of Points

list = Input(list: var[])
removeLast = Custom[RemoveLast](list=list)  # Remove Last element of a List
code_block = CodeBlock { -1; }
shiftIndices = List.ShiftIndices(list=list, amount=code_block)
removeLast_2 = Custom[RemoveLast](list=shiftIndices)
byStartPointEndPoint = Line.ByStartPointEndPoint(startPoint=removeLast, endPoint=removeLast_2)
Line = Output(byStartPointEndPoint)  # "Line[]"
