# Dynamo custom node LinetoFarPointfromMain.dyf (Dynamo 2.2.1.5175)
# category: PracticalBIM.Revit.Elements.MEP.RoutingGrids
# Creates a Line from farest Point to Main Line

startmainlinepoints = Input(startmainlinepoints: Autodesk.DesignScript.Geometry.Point[])
onlinepoints = Input(onlinepoints: Autodesk.DesignScript.Geometry.Point[])
geometryFarObject = Custom[GeometryFarObject](geometry=onlinepoints, other=startmainlinepoints, lacing=Shortest)  # Gets the geometry Farest Object
flatten = List.Flatten(list=geometryFarObject)
byStartPointEndPoint = Line.ByStartPointEndPoint(startPoint=startmainlinepoints, endPoint=flatten)
resultingline = Output(byStartPointEndPoint)  # "resultingline: Line[]"
