# Dynamo custom node ListGetEqualstoString.dyf (Dynamo 2.2.1.5175)
# category: PracticalBIM.Lists.Match
# Get all Values from elements equals to a String

stringvalues = Input(stringvalues: string)
stringtocompare = Input(stringtocompare: string)
eq = stringvalues == stringtocompare  # lacing=Longest
code_block = CodeBlock { true; }
allIndicesOf = List.AllIndicesOf(list=eq, item=code_block, lacing=Shortest)
lists = Output(allIndicesOf)
list = Input(list: var)
list_create = List.Create(item0=list)
getItemAtIndex = List.GetItemAtIndex(list=list_create, index=allIndicesOf, lacing=Shortest)
