# Dynamo custom node ListMatcher.dyf (Dynamo 2.2.1.5175)
# category: PracticalBIM.Lists.Match
# Creates a matches between lists

ListA = Input(ListA: var[]..[])
ListB = Input(ListB: var[]..[])
python_script = Python(IN[0]=ListA, IN[1]=ListB)
# ---------- python_script.python (46 lines) ----------
import clr
clr.AddReference('ProtoGeometry')
from Autodesk.DesignScript.Geometry import *

#The inputs to this node will be stored as a list in the IN variable.
A = IN[0]
B = IN[1]

listA = []
listB = []

#convert lists
if hasattr(A, "__iter__"):
	for i in range(0,len(A)):
		listA.append(A[i])
else:
	listA.append(A)
	
if hasattr(B, "__iter__"):
	for i in range(0,len(B)):
		listB.append(B[i])
else:
	listB.append(B)

# matched lists
lists = []

# if list A is larger than B, replicate the remaining digits of B
if len(listA) > len(listB):	
	dif = len(listA) - len(listB)
	for i in range(0,dif):
		listB.append(listB[len(listB)-1])
# if list B is larger than A, remove the remaining digits of B
elif len(listB) > len(listA):
	dif = len(listA) - len(listB)
	listC = []
	for i in range(0,len(listA)):
		listC.append(listB[i])
	listB = listC
		
lists.append(listA)
lists.append(listB)


#Assign your output to the OUT variable
OUT = lists
# ----------------------------------------
number = DoubleInput(1)
getItemAtIndex = List.GetItemAtIndex(list=python_script, index=number)
MatchListB = Output(getItemAtIndex)
number_2 = DoubleInput(0)
getItemAtIndex_2 = List.GetItemAtIndex(list=python_script, index=number_2)
ListA_2 = Output(getItemAtIndex_2)  # "ListA"
