# Dynamo custom node LocationofTextFirstRowforLegend.dyf (Dynamo 2.2.1.5175)
# category: PracticalBIM.Revit.View.Drafting
# It Brings the Location of Texts for the First Row on a Legend

points = Input(points: Autodesk.DesignScript.Geometry.Point[]..[])
firstItem = List.FirstItem(list=points)
firstItem_2 = List.FirstItem(list=firstItem)
code_block = CodeBlock { 0.2; }
code_block_2 = CodeBlock { -0.2; }
byCoordinates = Vector.ByCoordinates(x=code_block, y=code_block_2)
translate = Geometry.Translate(geometry=firstItem_2, direction=byCoordinates)
TitleLocation = Output(translate)  # "TitleLocation:Point"
restOfItems = List.RestOfItems(list=firstItem)
translate_2 = Geometry.Translate(geometry=restOfItems, direction=byCoordinates)
removeLast = Custom[RemoveLast](list=translate_2)  # Remove Last element of a List
OtherLocations = Output(removeLast)  # "OtherLocations:Point[]"
