# Dynamo custom node LowerZWithXYUpperPoint.dyf (Dynamo 2.2.1.5175)
# category: PracticalBIM.Geometry.Points
# Creates a Lower point using Z and XY of an Upper Point

LowerCurve = Input(LowerCurve: Autodesk.DesignScript.Geometry.Curve)
endPoint = Curve.EndPoint(curve=LowerCurve)
OriginalStartPoint = Output(endPoint)  # "OriginalStartPoint:Point"
HigherCurve = Input(HigherCurve: Autodesk.DesignScript.Geometry.Curve)
startPoint = Curve.StartPoint(curve=HigherCurve)
OriginalEndPoint = Output(startPoint)  # "OriginalEndPoint:Point[]"
X = Point.X(point=startPoint)
Y = Point.Y(point=startPoint)
Z = Point.Z(point=endPoint)
byCoordinates = Point.ByCoordinates(x=X, y=Y, z=Z)
LowerPoint = Output(byCoordinates)  # "LowerPoint:Point[]"
