# Dynamo custom node MEPConnectorVectorandSystemRectangular.dyf (Dynamo 2.2.1.5175)
# category: PracticalBIM.Revit.Elements.MEP.Connectors
# Gets the Connector Vector and System with a Rectangular Shape

element = Input(element: Revit.Elements.Element[]..[])
python_script = Python(IN[0]=element)
# ---------- python_script.python (149 lines) ----------
import clr
import math

clr.AddReference("RevitServices")
import RevitServices
from RevitServices.Persistence import DocumentManager
from RevitServices.Transactions import TransactionManager
doc = DocumentManager.Instance.CurrentDBDocument

clr.AddReference("RevitAPI")
import Autodesk
from Autodesk.Revit.DB import *

clr.AddReference("RevitNodes")
import Revit
clr.ImportExtensions(Revit.Elements)
clr.ImportExtensions(Revit.GeometryConversion)
#The inputs to this node will be stored as a list in the IN variables.
if isinstance(IN[0], list):
	fittings = UnwrapElement(IN[0])
	toggle = 0
else:
	toggle = 1
	fittings = [UnwrapElement(IN[0])]
	
	
def getConnSysType(connector):
	domain = connector.Domain
	if domain == Domain.DomainHvac:
		return connector.DuctSystemType.ToString()
	elif domain == Domain.DomainPiping:
		return connector.PipeSystemType.ToString()
	elif domain == Domain.DomainElectrical:
		return connector.ElectricalSystemType.ToString()
	else:
		return None
	

p = []
dir = []
fd = []
ref = []
conns = []
descript = []
H = []
W = []
R = []
MEP = []
Sys = []
Shap = []
sysClass = []

for fitting in fittings:
	
	
	points = []
	direction = []
	flowdir = []
	refs = []
	connlist = []
	description = []
	height = []
	width = []
	radius = []
	MEPSystem = []
	systemType = []
	shape = []
	systemclass = []
	
	try:
		connectors = fitting.MEPModel.ConnectorManager.Connectors
	except:
		try:
			connectors = fitting.ConnectorManager.Connectors
		except:			
			p.append(None)
			dir.append(None)
			fd.append(None)
			ref.append(None)
			conns.append(None)
			descript.append(None)
			H.append(None)
			W.append(None)
			R.append(None)
			Shap.append(None)
			MEP.append(None)
			Sys.append(None)
			sysClass.append(None)
			continue
	for conn in connectors:
		connlist.append(conn)
		description.append(conn.Description)
		try:
			height.append(conn.Height)
			width.append(conn.Width)
			radius.append(None)
		except:
			try:
				radius.append(conn.Radius)
				height.append(None)
				width.append(None)
			except:
				radius.append(None)
				height.append(None)
				width.append(None)
		shape.append((conn.Shape).ToString())
		
		try:
			MEPSystem.append(conn.MEPSystem.Name)
			systype = doc.GetElement(conn.MEPSystem.GetTypeId())
			systemType.append(systype)			
		except:
			MEPSystem.append(None)
			systemType.append(None)
		
		try:		
			systemclass.append(getConnSysType(conn))
		except:
			systemclass.append(None)
		
		points.append(conn.Origin.ToPoint())
		direction.append(conn.CoordinateSystem.BasisZ.ToVector())
		
		try:
			flowdir.append(conn.Direction.ToString())
		except:
			flowdir.append(None)
		for c in conn.AllRefs:
			refs.append(c.Owner)
	p.append(points)
	dir.append(direction)
	fd.append(flowdir)
	ref.append(refs)
	conns.append(connlist)
	descript.append(description)
	H.append(height)
	W.append(width)
	R.append(radius)
	MEP.append(MEPSystem)
	Sys.append(systemType)
	Shap.append(shape)
	sysClass.append(systemclass)


#Assign your output to the OUT variable.
if toggle:
	OUT = points, flowdir, refs, direction, connlist, description, height, width, radius, MEPSystem, systemType, shape, systemclass
else:
	OUT = p,fd,ref, dir, conns, descript, H, W, R, MEP, Sys, Shap, sysClass
# ----------------------------------------
code_block = CodeBlock(x=python_script) { x[0]; }
flatten = List.Flatten(list=code_block)
Points = Output(flatten)  # "Points[]"
code_block_2 = CodeBlock(x=python_script) { x[3]; }
flatten_2 = List.Flatten(list=code_block_2)
Direction = Output(flatten_2)  # "Direction[]"
code_block_3 = CodeBlock(x=python_script) { x[10]; }
flatten_3 = List.Flatten(list=code_block_3)
SystemType = Output(flatten_3)  # "SystemType[]"
code_block_4 = CodeBlock(x=python_script) { x[9]; }
flatten_4 = List.Flatten(list=code_block_4)
System = Output(flatten_4)  # "System[]"
code_block_5 = CodeBlock(x=python_script) { x[4]; }
flatten_5 = List.Flatten(list=code_block_5)
Connector = Output(flatten_5)  # "Connector[]"
code_block_6 = CodeBlock(x=python_script) { x[12]; }
flatten_6 = List.Flatten(list=code_block_6)
ConnectorSystemType = Output(flatten_6)  # "ConnectorSystemType[]"
code_block_7 = CodeBlock(x=python_script) { x[2]; }
flatten_7 = List.Flatten(list=code_block_7)
ConnectedElements = Output(flatten_7)  # "ConnectedElements[]"
code_block_8 = CodeBlock(x=python_script) { x[6]; }
Height = Output(code_block_8)
code_block_9 = CodeBlock(x=python_script) { x[7]; }
Width = Output(code_block_9)
