# Dynamo custom node ModifyLinebyLengthfromCenter.dyf (Dynamo 2.3.0.5885)
# category: PracticalBIM.Geometry.Curves
# Modifies a line creation from a length using same center

OriginalLines = Input(OriginalLines: Autodesk.DesignScript.Geometry.Line[])
code_block = CodeBlock { 0.5; }
pointAtParameter = Curve.PointAtParameter(curve=OriginalLines, param=code_block)
direction = Line.Direction(line=OriginalLines)
reverse = Vector.Reverse(vector=direction)
NewLengths = Input(NewLengths: double[])
code_block_2 = CodeBlock(a=NewLengths) { a/2; }
translate = Geometry.Translate(geometry=pointAtParameter, direction=reverse, distance=code_block_2)
translate_2 = Geometry.Translate(geometry=pointAtParameter, direction=direction, distance=code_block_2)
byStartPointEndPoint = Line.ByStartPointEndPoint(startPoint=translate, endPoint=translate_2)
NewLines = Output(byStartPointEndPoint)  # "NewLines:Line"
