# Dynamo custom node MoveBranchLinestoClosestSinglePoint.dyf (Dynamo 2.2.1.5175)
# category: PracticalBIM.Revit.Elements.MEP.RoutingGrids
# Moves a Set Branch to the closest location found

linetotranslate = Input(linetotranslate: Autodesk.DesignScript.Geometry.Line[])
seriesofonlinepoints = Input(seriesofonlinepoints: Autodesk.DesignScript.Geometry.Point[])
seriesoffixedpoints = Input(seriesoffixedpoints: Autodesk.DesignScript.Geometry.Point[])
distanceTo = Geometry.DistanceTo(geometry=seriesoffixedpoints, other=seriesofonlinepoints)
minimumItem = List.MinimumItem(list=distanceTo)
indexOf = List.IndexOf(list=distanceTo, element=minimumItem)
getItemAtIndex = List.GetItemAtIndex(list=seriesofonlinepoints@L2, index=indexOf, lacing=Shortest)
getItemAtIndex_2 = List.GetItemAtIndex(list=seriesoffixedpoints@L2, index=indexOf, lacing=Shortest)
byTwoPoints = Vector.ByTwoPoints(start=getItemAtIndex, end=getItemAtIndex_2)
translate = Geometry.Translate(geometry=linetotranslate, direction=byTwoPoints)
modifiedlines = Output(translate)  # "modifiedlines:Geometry.Line[]"
