# Dynamo custom node MoveLocationbyCropViewtoaIndexCurve.dyf (Dynamo 2.2.1.5175)
# category: PracticalBIM.GN
# Moves Location Points by an Index Curve and a Distance

GeometrytoProject = Input(GeometrytoProject: Autodesk.DesignScript.Geometry.Geometry[])
CropBoxCurves = Input(CropBoxCurves: Autodesk.DesignScript.Geometry.Line[])
projectedLocationfromCropView = Custom[ProjectedLocationfromCropView](CropBoxCurves=CropBoxCurves, GeometrytoProject=GeometrytoProject)  # Creates a Projected location on a CropView
index = Input(index: int)
getItemAtIndex = List.GetItemAtIndex(list=CropBoxCurves, index=index)
closestPointTo = Geometry.ClosestPointTo(geometry=getItemAtIndex, other=projectedLocationfromCropView)
flatten = List.Flatten(list=closestPointTo)
byTwoPoints = Vector.ByTwoPoints(start=projectedLocationfromCropView, end=flatten)
normalized = Vector.Normalized(vector=byTwoPoints)
scalefactor = Input(scalefactor: double)
scale = Vector.Scale(vector=normalized, scale_factor=scalefactor)
translate = Geometry.Translate(geometry=GeometrytoProject, direction=scale)
flatten_2 = List.Flatten(list=translate)
ResultantGeometry = Output(flatten_2)  # "ResultantGeometry:DesignScript.Geometry[]"
