# Dynamo custom node MovePointstoMinimunXYZ.dyf (Dynamo 2.2.1.5175)
# category: PracticalBIM.Geometry.Points
# Move all points to minimum location

PointsX = Input(PointsX: double[])
minimumItem = List.MinimumItem(list=PointsX)
code_block = CodeBlock(a=PointsX, b=minimumItem) { a-b; }
PointsY = Input(PointsY: double[])
minimumItem_2 = List.MinimumItem(list=PointsY)
code_block_2 = CodeBlock(a=PointsY, b=minimumItem_2) { a-b; }
PointsZ = Input(PointsZ: double[])
minimumItem_3 = List.MinimumItem(list=PointsZ)
code_block_3 = CodeBlock(a=PointsZ, b=minimumItem_3) { a-b; }
byCoordinates = Point.ByCoordinates(x=code_block, y=code_block_2, z=code_block_3)
NewPoints = Output(byCoordinates)  # "NewPoints:Point[]"
