# Dynamo custom node NumberStringWIthOneDecimal.dyf (Dynamo 2.3.0.5885)
# category: PracticalBIM.Math
# Creates a Number String WIth One Decimal

str = Input(str: string[])
code_block = CodeBlock { 0; }
code_block_2 = CodeBlock { "."; }
indexOf = String.IndexOf(str=str, searchFor=code_block_2)
code_block_3 = CodeBlock { -1; }
eq = indexOf == code_block_3
length = String.Length(str=str)
code_block_4 = CodeBlock(a=indexOf) { a+2; }
if_ = If(test=eq, true=length, false=code_block_4)
substring = String.Substring(str=str, startIndex=code_block, length=if_)
str_2 = Output(substring)  # "str:string[]"
