# Dynamo custom node NumberStringWithoutDecimals.dyf (Dynamo 2.5.0.7460)
# category: PracticalBIM.Math
# Gives a Number string with out decimals

str = Input(str: string[])
code_block = CodeBlock { 0; }
code_block_2 = CodeBlock { "."; }
indexOf = String.IndexOf(str=str, searchFor=code_block_2)
substring = String.Substring(str=str, startIndex=code_block, length=indexOf)
str_2 = Output(substring)  # "str:string[]"
