# Dynamo custom node ParseCSVDatetoDate.dyf (Dynamo 1.3.2.2480)
# category: PracticalBIM.Simulate
# Transform Dates from text to Dates in Dynamo

str = Input(str : string)
code_block = CodeBlock { " "; }
split = String.Split(str, code_block)
transpose = List.Transpose(split)
code_block_2 = CodeBlock { 0; }
getItemAtIndex = List.GetItemAtIndex(list=transpose, index=code_block_2)
code_block_3 = CodeBlock { "/"; }
split_2 = String.Split(getItemAtIndex, code_block_3)
transpose_2 = List.Transpose(split_2)
code_block_4 = CodeBlock { 2; }
getItemAtIndex_2 = List.GetItemAtIndex(list=transpose_2, index=code_block_4)
toNumber = String.ToNumber(getItemAtIndex_2)
code_block_5 = CodeBlock { 1; }
getItemAtIndex_3 = List.GetItemAtIndex(list=transpose_2, index=code_block_5)
toNumber_2 = String.ToNumber(getItemAtIndex_3)
code_block_6 = CodeBlock { 0; }
getItemAtIndex_4 = List.GetItemAtIndex(list=transpose_2, index=code_block_6)
toNumber_3 = String.ToNumber(getItemAtIndex_4)
code_block_7 = CodeBlock { 1; }
getItemAtIndex_5 = List.GetItemAtIndex(list=transpose, index=code_block_7)
code_block_8 = CodeBlock { ":"; }
split_3 = String.Split(getItemAtIndex_5, code_block_8)
transpose_3 = List.Transpose(split_3)
toNumber_4 = String.ToNumber(transpose_3)
getItemAtIndex_6 = List.GetItemAtIndex(list=toNumber_4, index=code_block_6)
code_block_9 = CodeBlock { 2; }
getItemAtIndex_7 = List.GetItemAtIndex(list=transpose, index=code_block_9)
add = getItemAtIndex_6 + getItemAtIndex_7
code_block_10 = CodeBlock { "12AM"; }
eq = add == code_block_10
code_block_11 = CodeBlock { 0; }
add_2 = getItemAtIndex_6 + getItemAtIndex_7
code_block_12 = CodeBlock { "12PM"; }
eq_2 = add_2 == code_block_12
code_block_13 = CodeBlock { 12; }
code_block_14 = CodeBlock { "PM"; }
eq_3 = getItemAtIndex_7 == code_block_14
code_block_15 = CodeBlock { 12; }
add_3 = getItemAtIndex_6 + code_block_15
if_ = If(test=eq_3, true=add_3, false=getItemAtIndex_6)
if_2 = If(test=eq_2, true=code_block_13, false=if_)
if_3 = If(test=eq, true=code_block_11, false=if_2)
getItemAtIndex_8 = List.GetItemAtIndex(list=toNumber_4, index=code_block_5)
byDateAndTime = DateTime.ByDateAndTime(toNumber, toNumber_2, toNumber_3, if_3, getItemAtIndex_8)
dateTime = Output(byDateAndTime)
