# Dynamo custom node ParseXLSDateToDate.dyf (Dynamo 1.3.2.2480)
# category: PracticalBIM.Simulate
# Parse XLS dates to Dynamo Dates

str = Input(str : string)
code_block = CodeBlock { " "; }
split = String.Split(str, code_block)
transpose = List.Transpose(split)
code_block_2 = CodeBlock { 2; }
getItemAtIndex = List.GetItemAtIndex(list=transpose, index=code_block_2)
toNumber = String.ToNumber(getItemAtIndex)
code_block_3 = CodeBlock { 1; }
getItemAtIndex_2 = List.GetItemAtIndex(list=transpose, index=code_block_3)
code_block_4 = CodeBlock { {"January","February","March","April","May","June","July","August","September","October","November","December"}; }
eq = getItemAtIndex_2 == code_block_4  # lacing=CrossProduct
boolean = BoolSelector(true)
indexOf = IndexOf(arg1=boolean)  # unwired: arg0
map = List.Map(list=eq, f_x=indexOf)
code_block_5 = CodeBlock { 1; }
add = map + code_block_5
code_block_6 = CodeBlock { 0; }
getItemAtIndex_3 = List.GetItemAtIndex(list=transpose, index=code_block_6)
toNumber_2 = String.ToNumber(getItemAtIndex_3)
code_block_7 = CodeBlock { 4; }
getItemAtIndex_4 = List.GetItemAtIndex(list=transpose, index=code_block_7)
code_block_8 = CodeBlock { "p."; }
eq_2 = getItemAtIndex_4 == code_block_8
code_block_9 = CodeBlock { 3; }
getItemAtIndex_5 = List.GetItemAtIndex(list=transpose, index=code_block_9)
code_block_10 = CodeBlock { ":"; }
split_2 = String.Split(getItemAtIndex_5, code_block_10)
transpose_2 = List.Transpose(split_2)
code_block_11 = CodeBlock { 0; }
getItemAtIndex_6 = List.GetItemAtIndex(list=transpose_2, index=code_block_11)
toNumber_3 = String.ToNumber(getItemAtIndex_6)
code_block_12 = CodeBlock { 12; }
add_2 = toNumber_3 + code_block_12
if_ = If(test=eq_2, true=add_2, false=toNumber_3)
code_block_13 = CodeBlock { 1; }
getItemAtIndex_7 = List.GetItemAtIndex(list=transpose_2, index=code_block_13)
toNumber_4 = String.ToNumber(getItemAtIndex_7)
byDateAndTime = DateTime.ByDateAndTime(toNumber, add, toNumber_2, if_, toNumber_4)
dateTime = Output(byDateAndTime)
