# Dynamo custom node ParsingDatedd_mm_yyyytoDateTimeandString.dyf (Dynamo 2.2.1.5175)
# category: PracticalBIM.Analysis.Time
# Parsing Date to Time and String

strwithFormat = Input(strwithFormat: string[])
code_block = CodeBlock { "/"; }
allIndicesOf = String.AllIndicesOf(str=strwithFormat, searchFor=code_block)
code_block_2 = CodeBlock { 1; }
getItemAtIndex = List.GetItemAtIndex(list=allIndicesOf@L2, index=code_block_2)
code_block_3 = CodeBlock(a=getItemAtIndex) { a+1; }
code_block_4 = CodeBlock { 4; }
substring = String.Substring(str=strwithFormat, startIndex=code_block_3, length=code_block_4)
toNumber = String.ToNumber(str=substring)
code_block_5 = CodeBlock { 0; }
getItemAtIndex_2 = List.GetItemAtIndex(list=allIndicesOf@L2, index=code_block_5)
code_block_6 = CodeBlock(a=getItemAtIndex_2) { a+1; }
code_block_7 = CodeBlock { 2; }
substring_2 = String.Substring(str=strwithFormat, startIndex=code_block_6, length=code_block_7)
toNumber_2 = String.ToNumber(str=substring_2)
code_block_8 = CodeBlock { 0; }
substring_3 = String.Substring(str=strwithFormat, startIndex=code_block_8, length=getItemAtIndex_2)
toNumber_3 = String.ToNumber(str=substring_3)
byDate = DateTime.ByDate(year=toNumber, month=toNumber_2, day=toNumber_3)
dateTime = Output(byDate)  # "dateTime:DSCore.DateTime[]"
code_block_9 = CodeBlock { 2; }
code_block_10 = CodeBlock { 2; }
substring_4 = String.Substring(str=substring, startIndex=code_block_9, length=code_block_10)
code_block_11 = CodeBlock(a=substring_4, b=substring_2, c=substring_3) { a+b+c; }
DatestringforInteger = Output(code_block_11)  # "DatestringforInteger:string[]"
