# Dynamo custom node PointsSortedbyVector.dyf (Dynamo 2.2.1.5175)
# category: PracticalBIM.Geometry.Points
# Sort Points by Vector

ReverseVector = Input(ReverseVector: bool = false)
UnsortedPoints = Input(UnsortedPoints: var[]..[])
flatten = List.Flatten(list=UnsortedPoints)
byBestFitThroughPoints = Line.ByBestFitThroughPoints(bestFitPoints=flatten)
parameterAtPoint = Curve.ParameterAtPoint(curve=byBestFitThroughPoints, point=flatten)
flatten_2 = List.Flatten(list=parameterAtPoint)
sortIndexByValue = List.SortIndexByValue(list=flatten_2)
getItemAtIndex = List.GetItemAtIndex(list=flatten, index=sortIndexByValue)
flatten_3 = List.Flatten(list=getItemAtIndex)
code_block = CodeBlock { true; }
clean = List.Clean(list=flatten_3, preserveIndices=code_block)
reverse = List.Reverse(list=clean)
if_ = If(test=ReverseVector, true=reverse, false=clean)
SortedPoints = Output(if_)
