# Dynamo custom node PointsToLines.dyf (Dynamo 2.2.1.5175)
# category: PracticalBIM.Geometry.Curves
# Converts a series of point into LInes

points = Input(points: Autodesk.DesignScript.Geometry.Point[])
byPoints = PolyCurve.ByPoints(points=points)
curves = PolyCurve.Curves(polyCurve=byPoints)
curvetoLine = Custom[CurvetoLine](curve=curves)  # Transform a Curve to a Line by StartPoint EndPoint
Line = Output(curvetoLine)  # "Line[]"
