# Dynamo custom node PointsXYZFromTextFile.dyf (Dynamo 2.2.1.5175)
# category: PracticalBIM.ImportExport.TXT
# Extracts from a Txt File values as Points X Y Z

file = Input(file: var)
readText = FileSystem.ReadText(file=file)
code_block = CodeBlock()
# ---------- code_block.designscript (2 lines) ----------
"
";
# ----------------------------------------
code_block_2 = CodeBlock { "!"; }
replace = String.Replace(str=readText, searchFor=code_block, replaceWith=code_block_2)
split = String.Split(str=replace, separator0=code_block_2)
trimWhitespace = String.TrimWhitespace(str=split)
code_block_3 = CodeBlock { ","; }
split_2 = String.Split(str=trimWhitespace, separator0=code_block_3)
XYZ = Output(split_2)  # "XYZ:string[]"
