# Dynamo custom node PointsbysequenceonZ.dyf (Dynamo 2.2.1.5175)
# category: PracticalBIM.Geometry.Points.RoallerCoaster
# Modify a series of points by a sequence on Z

curve = Input(curve: Autodesk.DesignScript.Geometry.Curve)
numberofpoints = Input(numberofpoints: double)
code_block = CodeBlock(n=numberofpoints) { 0..1..#n; }
pointAtParameter = Curve.PointAtParameter(curve=curve, param=code_block)
start = Input(start: double)
end = Input(end: double)
code_block_2 = CodeBlock(s=start, e=end, n=numberofpoints) { s..e..#n; }
byCoordinates = Vector.ByCoordinates(z=code_block_2)
translate = Geometry.Translate(geometry=pointAtParameter, direction=byCoordinates)
finalpoints = Output(translate)  # "finalpoints:Point[]"
