# Dynamo custom node ProjectStructuralFramingtoLowerLevel.dyf (Dynamo 2.3.0.5885)
# category: PracticalBIM.Revit.Elements.StructuralFramings
# Projects Structural Framing Line to a Lower Level
# packages: PracticalBIM 2020.0.26

curve = Input(curve: Autodesk.DesignScript.Geometry.Curve)
element = Input(element: Revit.Elements.Element)
code_block = CodeBlock { "Reference Level"; }
getParameterValueByName = Element.GetParameterValueByName(element=element, parameterName=code_block)
getLowerLevelfromLevelwithHeight = Custom[GetLowerLevelfromLevelwithHeight](element=getParameterValueByName)  # package PracticalBIM; Get Lower Level from Level with Height
byCoordinates = Point.ByCoordinates(z=getLowerLevelfromLevelwithHeight.heigthValue)
ZAxis = Vector.ZAxis()
byOriginNormal = Plane.ByOriginNormal(origin=byCoordinates, normal=ZAxis)
pullOntoPlane = Curve.PullOntoPlane(curve=curve, plane=byOriginNormal)
ProjectedCurve = Output(pullOntoPlane)  # "ProjectedCurve:Curve"
