# Dynamo custom node ProjectwithDownandUpTranslation.dyf (Dynamo 2.6.1.8786)
# category: PracticalBIM.Geometry.Transfer
# Projects a Point to a Base Geometry Down and Up

pointtoproject = Input(pointtoproject: Autodesk.DesignScript.Geometry.Geometry[])
code_block = CodeBlock { -50; }
byCoordinates = Vector.ByCoordinates(z=code_block)
translate = Geometry.Translate(geometry=pointtoproject, direction=byCoordinates)
baseGeometry = Input(baseGeometry: Autodesk.DesignScript.Geometry.Geometry)
code_block_2 = CodeBlock { 1; }
byCoordinates_2 = Vector.ByCoordinates(z=code_block_2)
project = Point.Project(point=translate, baseGeometry=baseGeometry, projectionDirection=byCoordinates_2, lacing=CrossProduct)
projectedGeometry = Output(project)  # "projectedGeometry:Geometry"
