# Dynamo custom node QuadGridbySurface.dyf (Dynamo 2.2.1.5175)
# category: PracticalBIM.Geometry.Paneling
# Creates a Quad Grid by  Surface

selectedsurface = Input(selectedsurface: Autodesk.DesignScript.Geometry.Surface)
U = Input(U: var[]..[])
listMatcher = Custom[ListMatcher](ListA=selectedsurface, ListB=U)  # Creates a matches between lists
V = Input(V: var[]..[])
listMatcher_2 = Custom[ListMatcher](ListA=selectedsurface, ListB=V)
python_script = Python(IN[0]=listMatcher.ListA, IN[1]=listMatcher.MatchListB, IN[2]=listMatcher_2.MatchListB)
# ---------- python_script.python (77 lines) ----------
#Copyright(c) 2014, Nathan Miller
# The Proving Ground, http://theprovingground.org

import clr
clr.AddReference('ProtoGeometry')
from Autodesk.DesignScript.Geometry import *

# Panel division class
class PanelDivision:
	
	# divide surface
	def QuadDivision(self, srf, udiv, vdiv):
		panels = []
		polys = []
		quads = []
	
		ustep = 1.0/udiv
		vstep = 1.0/vdiv
		for i in range(0,int(udiv)):
			for j in range(0,int(vdiv)):
				quad = []
				#XYZ Quads
				myXYZA = srf.PointAtParameter(i*ustep, j*vstep)
				myXYZB = srf.PointAtParameter((i+1)*ustep,j*vstep)
				myXYZC = srf.PointAtParameter((i+1)*ustep,(j+1)*vstep)
				myXYZD = srf.PointAtParameter(i*ustep,(j+1)*vstep)
				#Append to quad
				quad.append(myXYZA)
				quad.append(myXYZB)
				quad.append(myXYZC)
				quad.append(myXYZD)
				#Append quads
				quads.append(quad)
				
				#polygons
				poly = Polygon.ByPoints(quad)
				polys.append(poly)
				
				#panels
				panel = Surface.ByPerimeterPoints(quad)
				panels.append(panel)
				
		self.quads = quads
		self.polys = polys
		self.panels = panels


#main code here....

srf = IN[0]
	
udiv = IN[1]
vdiv = IN[2]
	
panels = []
polys = []
quads = []
	
for k in range(0, len(srf)):
	s = srf[k]
	u = udiv[k]
	v = vdiv[k]
			
	divide = PanelDivision()
	divide.QuadDivision(s,u,v)
					
	quads.append(divide.quads)
	panels.append(divide.panels)
	polys.append(divide.polys)
			
output = []
output.append(quads)
output.append(polys)
output.append(panels)
	
#Assign your output to the OUT variable
OUT = output
# ----------------------------------------
number = DoubleInput(0)
getItemAtIndex = List.GetItemAtIndex(list=python_script, index=number)
Panel_Pts = Output(getItemAtIndex)
number_2 = DoubleInput(1)
getItemAtIndex_2 = List.GetItemAtIndex(list=python_script, index=number_2)
Panel_Polys = Output(getItemAtIndex_2)
number_3 = DoubleInput(2)
getItemAtIndex_3 = List.GetItemAtIndex(list=python_script, index=number_3)
Panel_Faces = Output(getItemAtIndex_3)
