# Dynamo custom node RebarCoverLengthsfromanElement.dyf (Dynamo 2.2.1.5175)
# category: PracticalBIM.Rebar
# Gets the Rebar Cover Lengths from an Element

element = Input(element: Revit.Elements.Element[])
code_block = CodeBlock { "Rebar Cover - Top Face"; }
getParameterValueByName = Element.GetParameterValueByName(element=element, parameterName=code_block)
code_block_2 = CodeBlock { "Length"; }
getParameterValueByName_2 = Element.GetParameterValueByName(element=getParameterValueByName, parameterName=code_block_2)
code_block_3 = CodeBlock(a=getParameterValueByName_2) { a/1000; }
topcoveroffset = Output(code_block_3)  # "topcoveroffset:double[]"
code_block_4 = CodeBlock { "Rebar Cover - Bottom Face"; }
getParameterValueByName_3 = Element.GetParameterValueByName(element=element, parameterName=code_block_4)
code_block_5 = CodeBlock { "Length"; }
getParameterValueByName_4 = Element.GetParameterValueByName(element=getParameterValueByName_3, parameterName=code_block_5)
code_block_6 = CodeBlock(a=getParameterValueByName_4) { a/1000; }
bottomcoveroffset = Output(code_block_6)  # "bottomcoveroffset:double[]"
code_block_7 = CodeBlock { "Rebar Cover - Other Faces"; }
getParameterValueByName_5 = Element.GetParameterValueByName(element=element, parameterName=code_block_7)
code_block_8 = CodeBlock { "Length"; }
getParameterValueByName_6 = Element.GetParameterValueByName(element=getParameterValueByName_5, parameterName=code_block_8)
code_block_9 = CodeBlock(a=getParameterValueByName_6) { a/1000; }
othercoveroffset = Output(code_block_9)  # "othercoveroffset:double[]"
