# Dynamo custom node RegulateZValueonaListofPoints.dyf (Dynamo 2.6.1.8786)
# category: PracticalBIM.Geometry.Points
# Regulates the Z Values on a List of Points

point = Input(point: Autodesk.DesignScript.Geometry.Point[])
X = Point.X(point=point)
Y = Point.Y(point=point)
Z = Point.Z(point=point)
firstItem = List.FirstItem(list=Z)
lastItem = List.LastItem(list=Z)
count = List.Count(list=Z)
code_block = CodeBlock(a=firstItem, b=lastItem, c=count) { a..b..#c; }
byCoordinates = Point.ByCoordinates(x=X, y=Y, z=code_block)
Point = Output(byCoordinates)
