# Dynamo custom node RemoveFloorElementsfromListatElevation.dyf (Dynamo 2.2.1.5175)
# category: PracticalBIM.Revit.Elements.Floor
# Removes Floor Elements from a List by a elevation Value

element = Input(element: Revit.Elements.Element[])
code_block = CodeBlock { "Level"; }
getParameterValueByName = Element.GetParameterValueByName(element=element, parameterName=code_block)
code_block_2 = CodeBlock { "Elevation"; }
getParameterValueByName_2 = Element.GetParameterValueByName(element=getParameterValueByName, parameterName=code_block_2)
elevation = Input(elevation: double)
eq = getParameterValueByName_2 == elevation
code_block_3 = CodeBlock { true; }
allIndicesOf = List.AllIndicesOf(list=eq, item=code_block_3)
removeItemAtIndex = List.RemoveItemAtIndex(list=element, indices=allIndicesOf)
Element = Output(removeItemAtIndex)  # "Element[]"
