# Dynamo custom node RemoveLast.dyf (Dynamo 2.2.1.5175)
# category: PracticalBIM.Lists
# Remove Last element of a List

list = Input(list: var[]..[])
count = List.Count(list=list)
code_block = CodeBlock(a=count) { a-1; }
removeItemAtIndex = List.RemoveItemAtIndex(list=list, indices=code_block)
list_2 = Output(removeItemAtIndex)  # "list[]"
