# Dynamo custom node RemoveNListsBeginEnd.dyf (Dynamo 2.2.1.5175)
# category: PracticalBIM.Lists
# Remove a number of lists from the begining and end

list = Input(list: var[]..[])
numbertoremove = Input(numbertoremove: double)
code_block = CodeBlock(a=numbertoremove) { 0..#a..1; }
count = List.Count(list=list)
code_block_2 = CodeBlock(a=count, b=numbertoremove) { a-1..#b..-1; }
join = List.Join(list0=code_block, list1=code_block_2)
removeItemAtIndex = List.RemoveItemAtIndex(list=list, indices=join)
list_2 = Output(removeItemAtIndex)  # "list:var[]"
