# Dynamo custom node ReorderElementsLiLbyNumberofElements.dyf (Dynamo 2.3.0.5885)
# category: PracticalBIM.Math
# Gets a Reorder of Elements using the Distances from them

count = Input(count: int)
code_block = CodeBlock(a=count) { a-1; }
code_block_2 = CodeBlock(a=count) { a+1; }
code_block_3 = CodeBlock(n=code_block_2) { 0..n-2..2; }
count_2 = List.Count(list=code_block_3@L2)
code_block_4 = CodeBlock(a=count, b=count_2) { a-b; }
code_block_5 = CodeBlock(a=count_2, b=code_block_4) { a-b; }
code_block_6 = CodeBlock(a=code_block, b=code_block_5) { a-b; }
code_block_7 = CodeBlock(a=code_block_6, n=code_block_4) { a..#n..-2; }
addItemToEnd = List.AddItemToEnd(item=code_block_7@L2, list=code_block_3@L2)
code_block_8 = CodeBlock { 1; }
flatten = List.Flatten(list=addItemToEnd@L3, amt=code_block_8)
ListofIndexes = Output(flatten)  # "ListofIndexes:List"
