# Dynamo custom node RevitElementSetRotation.dyf (Dynamo 2.2.1.5175)
# category: PracticalBIM.Revit.Elements.Element
# Rotates on XY a Revit Element

element = Input(element: Revit.Elements.Element[])
elementType = Element.ElementType(element=element)
uniqueItems = List.UniqueItems(list=elementType)
byFamilyType = FamilyInstance.ByFamilyType(familyType=uniqueItems)
flatten = List.Flatten(list=byFamilyType)
id = Element.Id(element=flatten)
id_2 = Element.Id(element=element)
allIndicesOf = List.AllIndicesOf(list=id, item=id_2)
flatten_2 = List.Flatten(list=allIndicesOf)
getItemAtIndex = List.GetItemAtIndex(list=flatten, index=flatten_2)
degree = Input(degree: double[])
setRotation = FamilyInstance.SetRotation(familyInstance=getItemAtIndex, degree=degree)
FamilyInstance = Output(setRotation)  # "FamilyInstance[]"
