# Dynamo custom node RoadbyCurveandWidth.dyf (Dynamo 2.6.1.8786)
# category: PracticalBIM.Revit.Elements.Roads
# Creates a Surface Road by a Curve and a Width
# packages: PracticalBIM 2020.0.38

curve = Input(curve: Autodesk.DesignScript.Geometry.Curve)
code_block = CodeBlock { 0..1..#20; }
pointAtParameter = Curve.PointAtParameter(curve=curve, param=code_block)
getOrientationVectorsFromPointsandCurves = Custom[GetOrientationVectorsFromPointsandCurvesSE](curve=curve, points=pointAtParameter)  # package PracticalBIM; Get all orientation vectors and Points from a Line from start to end
coordinateSystembyPointandVectorOveraCur = Custom[CoordinateSystembyPointandVectorOveraCurveforLinearFamilies](vector=getOrientationVectorsFromPointsandCurves, origin=pointAtParameter)  # package PracticalBIM; Creates a Coordinate System on Everypoint with Vectors over a Curve
width = Input(width: double)
code_block_2 = CodeBlock(a=width) { a/2; }
code_block_3 = CodeBlock(a=code_block_2) { a*-1; }
byCartesianCoordinates = Point.ByCartesianCoordinates(cs=coordinateSystembyPointandVectorOveraCur, x=code_block_3)
byCartesianCoordinates_2 = Point.ByCartesianCoordinates(cs=coordinateSystembyPointandVectorOveraCur, x=code_block_2)
byStartPointEndPoint = Line.ByStartPointEndPoint(startPoint=byCartesianCoordinates, endPoint=byCartesianCoordinates_2)
byLoft = Surface.ByLoft(crossSections=byStartPointEndPoint)
Surface = Output(byLoft)
