# Dynamo custom node SanitaryConnectionDownandSlopes.dyf (Dynamo 2.2.1.5175)
# category: PracticalBIM.Revit.Elements.MEP.Sanitary
# Get the Sanitary Connection Down with Slopes

pipeline = Input(pipeline: Autodesk.DesignScript.Geometry.Line)
vectorofalinegoingdown = Custom[Vectorofalinegoingdown](curve=pipeline)  # Gets the vector of a line going down
connectorpoints = Input(connectorpoints: Autodesk.DesignScript.Geometry.Point[])
closestPointTo = Geometry.ClosestPointTo(geometry=pipeline, other=connectorpoints)
coordinateSystembyPointandVectorOveraCur = Custom[CoordinateSystembyPointandVectorOveraCurveforLinearFamilies](vector=vectorofalinegoingdown, origin=closestPointTo, lacing=Longest)  # Creates a Coordinate System on Everypoint with Vectors over a Curve
radius = Input(radius: double[])
code_block = CodeBlock(a=radius) { a*0.3048*2; }
code_block_2 = CodeBlock(a=code_block) { a*4; }
byCartesianCoordinates = Point.ByCartesianCoordinates(cs=coordinateSystembyPointandVectorOveraCur, z=code_block_2)
Z = Point.Z(point=byCartesianCoordinates)
code_block_3 = CodeBlock(a=code_block_2) { -a; }
byCartesianCoordinates_2 = Point.ByCartesianCoordinates(cs=coordinateSystembyPointandVectorOveraCur, z=code_block_3)
Z_2 = Point.Z(point=byCartesianCoordinates_2)
gt = Z > Z_2
if_ = If(test=gt, true=byCartesianCoordinates_2, false=byCartesianCoordinates)
byCartesianCoordinates_3 = Point.ByCartesianCoordinates(cs=coordinateSystembyPointandVectorOveraCur, x=code_block_3)
distanceTo = Geometry.DistanceTo(geometry=connectorpoints, other=byCartesianCoordinates_3)
byCartesianCoordinates_4 = Point.ByCartesianCoordinates(cs=coordinateSystembyPointandVectorOveraCur, x=code_block_2)
distanceTo_2 = Geometry.DistanceTo(geometry=connectorpoints, other=byCartesianCoordinates_4)
gt_2 = distanceTo > distanceTo_2
if_2 = If(test=gt_2, true=byCartesianCoordinates_4, false=byCartesianCoordinates_3)
linebyStartPointEndPoint = Line.ByStartPointEndPoint(startPoint=if_, endPoint=if_2)
line1 = List.Flatten(list=linebyStartPointEndPoint)
Line1 = Output(line1)  # "Line1:Line[]"
connectordirection = Input(connectordirection: Autodesk.DesignScript.Geometry.Vector[])
translate = Geometry.Translate(geometry=connectorpoints, direction=connectordirection)
byStartPointEndPoint = Line.ByStartPointEndPoint(startPoint=connectorpoints, endPoint=translate)
byLineAndPoint = Plane.ByLineAndPoint(line=linebyStartPointEndPoint, point=closestPointTo)
intersect = Geometry.Intersect(geometry=byStartPointEndPoint, other=byLineAndPoint)
flatten = List.Flatten(list=intersect)
line_2 = Line.ByStartPointEndPoint(startPoint=if_2, endPoint=flatten)
line2 = List.Flatten(list=line_2)
Line2 = Output(line2)  # "Line2:Line[]"
line_3 = Line.ByStartPointEndPoint(startPoint=flatten, endPoint=connectorpoints)
Line3 = Output(line_3)  # "Line3:Line[]"
