# Dynamo custom node ScheduleChangeHeaders.dyf (Dynamo 2.6.1.8786)
# category: PracticalBIM.Revit.View.Schedules
# Change Schedule Headers

schedule = Input(schedule: Revit.Elements.Views.ScheduleView[]..[])
parametername = Input(parametername: string[]..[])
columnheading = Input(columnheading: string[]..[])
python_script = Python(IN[0]=schedule, IN[1]=parametername, IN[2]=columnheading)
# ---------- python_script.python (70 lines) ----------
#Copyright(c) 2014, Konrad Sobon
# @arch_laboratory, http://archi-lab.net

import clr
clr.AddReference('ProtoGeometry')
from Autodesk.DesignScript.Geometry import *

# Import DocumentManager and TransactionManager
clr.AddReference("RevitServices")
import RevitServices
from RevitServices.Persistence import DocumentManager
from RevitServices.Transactions import TransactionManager

# Import RevitAPI
clr.AddReference("RevitAPI")
import Autodesk
from Autodesk.Revit.DB import *

doc = DocumentManager.Instance.CurrentDBDocument
uiapp = DocumentManager.Instance.CurrentUIApplication
app = uiapp.Application

from System.Collections.Generic import *

# Import ToDSType(bool) extension method
clr.AddReference("RevitNodes")
import Revit
clr.ImportExtensions(Revit.Elements)

#The inputs to this node will be stored as a list in the IN variable.
dataEnteringNode = IN

_keySchedule = UnwrapElement(IN[0])
_paramName = IN[1]
_columnHeading = IN[2]

def getField(schedule, name):
	definition = schedule.Definition
	count = definition.GetFieldCount()
	for i in range(0, count, 1):
		if definition.GetField(i).GetName() == name:
			field = definition.GetField(i)
	return field

def formatColumn(field, heading):
	message = None
	if heading != None:
		field.ColumnHeading = heading
	return message

#"Start" the transaction
TransactionManager.Instance.EnsureInTransaction(doc)

message = None
if type(_paramName) == list:
	for i, j in zip(_paramName, _columnHeading):
		scheduleField = getField(_keySchedule, i)
		message = formatColumn(scheduleField, j)
else:
	scheduleField = getField(_keySchedule, _paramName)
	message = formatColumn(scheduleField, _columnHeading, _hidden, _headingOrientation, _horizontalAlignment, _sheetColumnWidth)

# "End" the transaction
TransactionManager.Instance.TransactionTaskDone()

#Assign your output to the OUT variable
if message == None:
	OUT = 0
else:
	OUT = '\n'.join('{:^35}'.format(s) for s in message.split('\n'))
# ----------------------------------------
OUT = Output(python_script)
