# Dynamo custom node ScheduleViewAddFieldsfromString.dyf (Dynamo 2.2.1.5175)
# category: PracticalBIM.Revit.View.Schedules
# Add Fields to Schedule Views

scheduleView = Input(scheduleView: Revit.Elements.Views.ScheduleView[])
schedulableFields = ScheduleView.SchedulableFields(scheduleView=scheduleView)
name = Revit.Schedules.SchedulableField.Name(schedulableField=schedulableFields)
strings = Input(strings: string[])
indexOf = List.IndexOf(list=name@L2, element=strings)
getItemAtIndex = List.GetItemAtIndex(list=schedulableFields@L2, index=indexOf@L2)
addFields = ScheduleView.AddFields(scheduleView=scheduleView, fields=getItemAtIndex)
scheduleView_2 = Output(addFields)  # "scheduleView[]"
