# Dynamo custom node SelectElementbyComparisonofValues.dyf (Dynamo 2.3.0.5885)
# category: PracticalBIM.Revit.Elements
# Selects the Element by Comparison of Values

listofvaluesrequired = Input(listofvaluesrequired: int[])
listtocomparefrom = Input(listtocomparefrom: double[])
string_from_object = FromObject(obj=listtocomparefrom)
listofvalues = Input(listofvalues: double[])
string_from_object_2 = FromObject(obj=listofvalues)
toNumber = String.ToNumber(str=string_from_object_2)
adjustmentdiference = Input(adjustmentdiference: double)
code_block = CodeBlock(a=toNumber, b=adjustmentdiference) { a-b; }
string_from_object_3 = FromObject(obj=code_block)
indexOf = List.IndexOf(list=string_from_object, element=string_from_object_3)
getItemAtIndex = List.GetItemAtIndex(list=listofvaluesrequired, index=indexOf)
listofelements = Output(getItemAtIndex)  # "listofelements:var"
