# Dynamo custom node SelectbyGivenLengthDistanceWithLesserRemainder.dyf (Dynamo 2.3.0.5885)
# category: PracticalBIM.GD.Splits
# Selects by a Given Length a Distance with the Smallest Remainder

curveliststodivide = Input(curveliststodivide: double[])
LengthsofLists = Input(LengthsofLists: double[])
gt = curveliststodivide > LengthsofLists  # lacing=CrossProduct
code_block = CodeBlock { true; }
allIndicesOf = List.AllIndicesOf(list=gt@L2, item=code_block)
getItemAtIndex = List.GetItemAtIndex(list=LengthsofLists, index=allIndicesOf)
sub = curveliststodivide - getItemAtIndex  # lacing=Shortest
minimumItem = List.MinimumItem(list=sub@L2)
indexOf = List.IndexOf(list=sub@L2, element=minimumItem@L1)
selectedelement = Output(indexOf)  # "selectedelement:int[]"
remainder = Output(minimumItem)  # "remainder:double[]"
