# Dynamo custom node SelectingTypeValueFromList.dyf (Dynamo 2.6.1.8786)
# category: PracticalBIM.Lists.Match
# Selects from a List the best Fit for Lower value

lengthofelement = Input(lengthofelement: double)
listofposiblevalues = Input(listofposiblevalues: double[])
le = lengthofelement <= listofposiblevalues  # lacing=CrossProduct
code_block = CodeBlock { true; }
firstIndexOf = List.FirstIndexOf(list=le@L2, item=code_block)
selectedindex = Output(firstIndexOf)  # "selectedindex:int"
