# Dynamo custom node SetColorsForSimulationParameter.dyf (Dynamo 1.3.2.2480)
# category: PracticalBIM.Simulate
# Set Colors by Range on Simulation Parameters

Category = Input()
all_elements_of_category = ElementsOfCategory(Category)
code_block = CodeBlock { "Simulation"; }
getParameterValueByName = Element.GetParameterValueByName(element=all_elements_of_category, parameterName=code_block)
uniqueItems = List.UniqueItems(getParameterValueByName)
count = Count(uniqueItems)
code_block_2 = CodeBlock(n=count) { 1..n..#n; }
code_block_3 = CodeBlock { 0; }
code_block_4 = CodeBlock { 1; }
remapRange = Math.RemapRange(numbers=code_block_2, newMin=code_block_3, newMax=code_block_4)
eq = getParameterValueByName == uniqueItems  # lacing=CrossProduct
boolean = BoolSelector(true)
indexOf = IndexOf(arg1=boolean)  # unwired: arg0
map = List.Map(list=eq, f_x=indexOf)
getItemAtIndex = List.GetItemAtIndex(list=remapRange, index=map)
color_range = ColorRange(arg2=getItemAtIndex)  # unwired: arg0, arg1
fill_patterns = FillPatterns("Solid fill")
byProperties = Revit.Filter.OverrideGraphicSettings.ByProperties(arg1=color_range, arg5=fill_patterns)
overrideInView = Element.OverrideInView(element=all_elements_of_category, overrides=byProperties)
Element = Output(overrideInView)
