# Dynamo custom node SetGroupsandkeysfromLocations.dyf (Dynamo 2.2.1.5175)
# category: PracticalBIM.4dSimulation
# SetsGroupsandkeysfromLocations

element = Input(element: Revit.Elements.Element[])
code_block = CodeBlock { "_"; }
code_block_2 = CodeBlock { ["LO_Building","LO_Level","LO_Zones"]; }
getParameterValueByName = Element.GetParameterValueByName(element=element, parameterName=code_block_2, lacing=CrossProduct)
join = String.Join(separator=code_block, string0=getParameterValueByName)
flatten = List.Flatten(list=join)
code_block_3 = CodeBlock { 1; }
getItemAtIndex = List.GetItemAtIndex(list=getParameterValueByName@L2, index=code_block_3)
code_block_4 = CodeBlock { 1; }
length = String.Length(str=getItemAtIndex)
code_block_5 = CodeBlock(a=length, b=code_block_4) { a-b; }
substring = String.Substring(str=getItemAtIndex, startIndex=code_block_4, length=code_block_5)
toNumber = String.ToNumber(str=substring)
code_block_6 = CodeBlock { 2; }
getItemAtIndex_2 = List.GetItemAtIndex(list=getParameterValueByName@L2, index=code_block_6)
length_2 = String.Length(str=getItemAtIndex_2)
code_block_7 = CodeBlock(a=length_2, b=code_block_4) { a-b; }
substring_2 = String.Substring(str=getItemAtIndex_2, startIndex=code_block_4, length=code_block_7)
toNumber_2 = String.ToNumber(str=substring_2)
list_create = List.Create(item0=element, item1=flatten, item2=toNumber, item3=toNumber_2)
code_block_8 = CodeBlock { 2; }
code_block_9 = CodeBlock { 3; }
sortListofListsL2 = Custom[SortListofListsL2](seq=list_create, sortIndex1=code_block_8, sortIndex2=code_block_9)  # Sort with two levels multiple lists
code_block_10 = CodeBlock { 0; }
getItemAtIndex_3 = List.GetItemAtIndex(list=sortListofListsL2, index=code_block_10)
code_block_11 = CodeBlock { 1; }
getItemAtIndex_4 = List.GetItemAtIndex(list=sortListofListsL2, index=code_block_11)
groupByKey = List.GroupByKey(list=getItemAtIndex_3, keys=getItemAtIndex_4)
keysofelements = Output(groupByKey.unique_keys)  # "keysofelements:string[]"
groupsofelements = Output(groupByKey.groups)  # "groupsofelements:Element[]..[]"
