# Dynamo custom node SetPeriodofUsebyTimeSchedules.dyf (Dynamo 2.2.1.5175)
# category: PracticalBIM.Analysis.Time
# SetPeriodofUsebyTimeSchedules

elementtimeasint = Input(elementtimeasint: int[])
timeintervals = Input(timeintervals: string[])
toNumber = String.ToNumber(str=timeintervals)
sub = elementtimeasint - toNumber  # lacing=CrossProduct
code_block = CodeBlock { 0; }
lt = sub < code_block
code_block_2 = CodeBlock(a=sub) { a-10; }
if_ = If(test=lt, true=code_block_2, false=sub)
abs = Math.Abs(number=if_)
minimumItem = List.MinimumItem(list=abs)
eq = abs == minimumItem
code_block_3 = CodeBlock { true; }
indexOf = List.IndexOf(list=eq@L2, element=code_block_3)
code_block_4 = CodeBlock(a=indexOf) { a+1; }
timeperiod = Output(code_block_4)  # "timeperiod:int[]"
