# Dynamo custom node SettingParameterSimPartonElements.dyf (Dynamo 2.2.1.5175)
# category: PracticalBIM.4dSimulation
# Sets the Parameter value Sim Part to the elements

sortedlistofsimulation = Input(sortedlistofsimulation: var[]..[])
code_block = CodeBlock { 0; }
getItemAtIndex = List.GetItemAtIndex(list=sortedlistofsimulation, index=code_block)
code_block_2 = CodeBlock { 4; }
getItemAtIndex_2 = List.GetItemAtIndex(list=sortedlistofsimulation, index=code_block_2)
groupByKey = List.GroupByKey(list=getItemAtIndex, keys=getItemAtIndex_2)
code_block_3 = CodeBlock { "SIM_PART"; }
count = List.Count(list=groupByKey.groups@L2)
code_block_4 = CodeBlock(a=count) { 1..a..1; }
code_block_5 = CodeBlock(a=groupByKey.unique_keys, b=code_block_4) { a+"_"+b; }
setParameterByName = Element.SetParameterByName(element=groupByKey.groups, parameterName=code_block_3, value=code_block_5)
resultingelementlist = Output(setParameterByName)  # "resultingelementlist:Element[]..[]"
SimulationPartValue = Output(code_block_5)  # "SimulationPartValue:string[]"
