# Dynamo custom node SettingQuantityParameterbyParameterandUnitMEP.dyf (Dynamo 2.2.1.5175)
# category: PracticalBIM.Revit.Elements.StructuralFramings
# Sets Quantity Parameters by Parameter Value and Unit Responding to MEP Requirements of Size and Counts

element = Input(element: Revit.Elements.Element[])
code_block = CodeBlock { "UN_Measure"; }
unittext = Input(unittext: string)
setParameterByName = Element.SetParameterByName(element=element, parameterName=code_block, value=unittext)
code_block_2 = CodeBlock { "UN_Parameter"; }
parameterName = Input(parameterName: string)
setParameterByName_2 = Element.SetParameterByName(element=setParameterByName, parameterName=code_block_2, value=parameterName)
code_block_3 = CodeBlock { "UN_Quantity"; }
code_block_4 = CodeBlock { "Count"; }
eq = parameterName == code_block_4
code_block_5 = CodeBlock { 1; }
count = List.Count(list=element)
ofRepeatedItem = List.OfRepeatedItem(item=code_block_5, amount=count)
getParameterValueByName = Element.GetParameterValueByName(element=element, parameterName=parameterName)
if_ = If(test=eq, true=ofRepeatedItem, false=getParameterValueByName)
setParameterByName_3 = Element.SetParameterByName(element=setParameterByName_2, parameterName=code_block_3, value=if_)
code_block_6 = CodeBlock { "UN_Code"; }
code_block_7 = CodeBlock { "Type"; }
getParameterValueByName_2 = Element.GetParameterValueByName(element=element, parameterName=code_block_7)
code_block_8 = CodeBlock { "Type Name"; }
getParameterValueByName_3 = Element.GetParameterValueByName(element=getParameterValueByName_2, parameterName=code_block_8)
SubParameter = Input(SubParameter: string)
getParameterValueByName_4 = Element.GetParameterValueByName(element=element, parameterName=SubParameter)
code_block_9 = CodeBlock(a=getParameterValueByName_3, b=getParameterValueByName_4) { a+"_"+b; }
setParameterByName_4 = Element.SetParameterByName(element=setParameterByName_3, parameterName=code_block_6, value=code_block_9)
uniqueItems = List.UniqueItems(list=code_block_9)
allIndicesOf = List.AllIndicesOf(list=code_block_9, item=uniqueItems)
getItemAtIndex = List.GetItemAtIndex(list=setParameterByName_4, index=allIndicesOf)
code_block_10 = CodeBlock { "UN_Total"; }
getItemAtIndex_2 = List.GetItemAtIndex(list=if_, index=allIndicesOf)
sum = Math.Sum(values=getItemAtIndex_2)
setParameterByName_5 = Element.SetParameterByName(element=getItemAtIndex, parameterName=code_block_10, value=sum)
