# Dynamo custom node SheduleisItemized.dyf (Dynamo 2.2.1.5175)
# category: PracticalBIM.Revit.View.Schedules
# Set the schedules to be itemized

schedule = Input(schedule: Revit.Elements.Views.ScheduleView[])
Itemized = Input(Itemized: bool)
python_script = Python(IN[0]=schedule, IN[1]=Itemized)
# ---------- python_script.python (31 lines) ----------
import clr

# Import DocumentManager and TransactionManager
clr.AddReference("RevitServices")
import RevitServices
from RevitServices.Persistence import DocumentManager
from RevitServices.Transactions import TransactionManager
doc = DocumentManager.Instance.CurrentDBDocument

ProcessLists = lambda function, lists: [ProcessLists(function, item) if isinstance(item, list) else function(item) for item in lists]
ApplyFunction = lambda func, objs: ProcessLists(func, objs) if isinstance(objs, list) else [func(objs)]

def Unwrap(item):
    return UnwrapElement(item)
    
if isinstance(IN[0], list):
	schedule = ProcessLists(Unwrap, IN[0])
else:
	schedule = Unwrap(IN[0])

itemize = IN[1]
	
def task(schedule):
	definition = schedule.Definition
	result = definition
	TransactionManager.Instance.EnsureInTransaction(doc)
	result.IsItemized = itemize
	TransactionManager.Instance.TransactionTaskDone()
	return result

OUT = ApplyFunction(task,schedule)
# ----------------------------------------
OUT = Output(python_script)
