# Dynamo custom node SimPartsbySimOrigins.dyf (Dynamo 1.3.2.2480)
# category: PracticalBIM.Simulate
# Develop the Simulation Parts and Origins

Category = Input()
all_elements_of_category = ElementsOfCategory(Category)
code_block = CodeBlock { "Simulation"; }
getParameterValueByName = Element.GetParameterValueByName(element=all_elements_of_category, parameterName=code_block)
geometry = Element.Geometry(all_elements_of_category)
centroid = Solid.Centroid(geometry)
flatten = Flatten(centroid)
code_block_2 = CodeBlock { "Sim Ori"; }
getParameterValueByName_2 = Element.GetParameterValueByName(element=all_elements_of_category, parameterName=code_block_2)
code_block_3 = CodeBlock { 1; }
eq = getParameterValueByName_2 == code_block_3
filterByBoolMask = List.FilterByBoolMask(list=flatten, mask=eq)
flatten_2 = Flatten(filterByBoolMask.in)
filterByBoolMask_2 = List.FilterByBoolMask(list=getParameterValueByName, mask=eq)
flatten_3 = Flatten(filterByBoolMask_2.in)
eq_2 = getParameterValueByName == flatten_3  # lacing=CrossProduct
boolean = BoolSelector(true)
indexOf = IndexOf(arg1=boolean)  # unwired: arg0
map = List.Map(list=eq_2, f_x=indexOf)
getItemAtIndex = List.GetItemAtIndex(list=flatten_2, index=map)
distanceTo = Geometry.DistanceTo(geometry=flatten, other=getItemAtIndex)
create = List.Create(all_elements_of_category, getParameterValueByName, distanceTo)
code_block_4 = CodeBlock { 1; }
code_block_5 = CodeBlock { 2; }
sortListofListsL2 = Custom[SortListofListsL2](seq=create, sortIndex1=code_block_4, sortIndex2=code_block_5)  # Sort with two levels multiple lists
code_block_6 = CodeBlock { 0; }
getItemAtIndex_2 = List.GetItemAtIndex(list=sortListofListsL2, index=code_block_6)
code_block_7 = CodeBlock { "Sim Parts"; }
code_block_8 = CodeBlock { 1; }
getItemAtIndex_3 = List.GetItemAtIndex(list=sortListofListsL2, index=code_block_8)
groupByKey = List.GroupByKey(list=getItemAtIndex_3, keys=getItemAtIndex_3)
count = List.Count(groupByKey.groups, lacing=CrossProduct)
code_block_9 = CodeBlock(n=count) { 1..n..#n; }
flatten_4 = Flatten(code_block_9)
string_from_object = FromObject(flatten_4)
code_block_10 = CodeBlock(a=getItemAtIndex_3, b=string_from_object) { a+"_"+b; }
setParameterByName = Element.SetParameterByName(element=getItemAtIndex_2, parameterName=code_block_7, value=code_block_10)
Element = Output(setParameterByName)
out = Output(filterByBoolMask.out)
out_2 = Output(filterByBoolMask_2.out)  # "out"
unique_keys = Output(groupByKey.unique_keys)
