# Dynamo custom node SimplifyParalellAlignedGroupofLines.dyf (Dynamo 2.6.1.8786)
# category: PracticalBIM.Geometry.Curves
# Simplify a Parallel Aligned group of Lines
# packages: PracticalBIM 2020.0.32

lines = Input(lines: Autodesk.DesignScript.Geometry.Line[])
startPoint = Curve.StartPoint(curve=lines)
endPoint = Curve.EndPoint(curve=lines)
join = List.Join(list0=startPoint, list1=endPoint)
getUniquePoints = Custom[GetUniquePoints](AllPoints=join)  # package PracticalBIM; Gets all Unique Points
X = Point.X(point=getUniquePoints)
minimumItem = List.MinimumItem(list=X)
Y = Point.Y(point=getUniquePoints)
minimumItem_2 = List.MinimumItem(list=Y)
byCoordinates = Point.ByCoordinates(x=minimumItem, y=minimumItem_2)
maximumItem = List.MaximumItem(list=X)
maximumItem_2 = List.MaximumItem(list=Y)
byCoordinates_2 = Point.ByCoordinates(x=maximumItem, y=maximumItem_2)
byStartPointEndPoint = Line.ByStartPointEndPoint(startPoint=byCoordinates, endPoint=byCoordinates_2)
ResultingLine = Output(byStartPointEndPoint)  # "ResultingLine:Line"
