# Dynamo custom node SortElementsByParameterName.dyf (Dynamo 2.2.1.5175)
# category: PracticalBIM.Revit.Elements.Element
# Sorts all Elements by Parameter Name

element = Input(element: Revit.Elements.Element[])
parameterName = Input(parameterName: string)
getParameterValueByName = Element.GetParameterValueByName(element=element, parameterName=parameterName)
name = Element.Name(element=getParameterValueByName)
uniqueItems = List.UniqueItems(list=name)
sort = List.Sort(list=uniqueItems)
allIndicesOf = List.AllIndicesOf(list=name, item=sort)
getItemAtIndex = List.GetItemAtIndex(list=element, index=allIndicesOf)
flatten = List.Flatten(list=getItemAtIndex)
Elements = Output(flatten)  # "Elements[]"
