# Dynamo custom node SortListofListsL4.dyf (Dynamo 1.3.2.2480)
# category: PracticalBIM.Sorting
# Sort 4 levels of Lists

seq = Input()
code_block = CodeBlock(seq=seq) { List.Transpose(seq); }
sortIndex1 = Input(sortIndex1 : int = 0)
sortIndex2 = Input(sortIndex2 : int = 0)
sortIndex3 = Input(sortIndex3 : int = 0)
sortIndex4 = Input(sortIndex4 : int = 0)
python_script = Python(IN[0]=code_block, IN[1]=sortIndex1, IN[2]=sortIndex2, IN[3]=sortIndex3, IN[4]=sortIndex4)
# ---------- python_script.python (10 lines) ----------
import clr

lists = IN[0]
sortindex = int(IN[1])
sortindex2 = int(IN[2])
sortindex3 = int(IN[3])
sortindex4 = int(IN[4])

OUT = sorted(lists, key=lambda lists:(lists[sortindex],lists[sortindex2],lists[sortindex3],lists[sortindex4]))
		
# ----------------------------------------
code_block_2 = CodeBlock(seq=python_script) { List.Transpose(seq); }
seq_2 = Output(code_block_2)  # "seq"
