# Dynamo custom node SortingLocationsCategoriesandElementsforSetup.dyf (Dynamo 2.2.1.5175)
# category: PracticalBIM.4dSimulation
# Sorting Location of Categories and Elements for Setup for Parts

ElementsList = Input(ElementsList: Revit.Elements.Element[])
CategoryPriority = Input(CategoryPriority: string[])
toNumber = String.ToNumber(str=CategoryPriority)
LocationParameters = Input(LocationParameters: string[]..[])
code_block = CodeBlock { 1; }
length = String.Length(str=LocationParameters)
code_block_2 = CodeBlock(a=length) { a-1; }
substring = String.Substring(str=LocationParameters, startIndex=code_block, length=code_block_2)
transpose = List.Transpose(lists=substring)
code_block_3 = CodeBlock { 1; }
getItemAtIndex = List.GetItemAtIndex(list=transpose, index=code_block_3)
toNumber_2 = String.ToNumber(str=getItemAtIndex)
LocationGrids = Input(LocationGrids: string[])
code_block_4 = CodeBlock { 1; }
length_2 = String.Length(str=LocationGrids)
code_block_5 = CodeBlock(a=length_2, b=code_block_4) { a-b; }
substring_2 = String.Substring(str=LocationGrids, startIndex=code_block_4, length=code_block_5)
toNumber_3 = String.ToNumber(str=substring_2)
SimulationValues = Input(SimulationValues: string[])
list_create = List.Create(item0=ElementsList, item1=toNumber, item2=toNumber_2, item3=toNumber_3, item4=SimulationValues)
code_block_6 = CodeBlock { 1; 2; 3; }
sortListofListsL3 = Custom[SortListofListsL3](seq=list_create, sortIndex1=code_block_6.out0, sortIndex2=code_block_6.out1, sortIndex3=code_block_6.out2)  # Sort Three levels of Lists by index
ResultingSortedList = Output(sortListofListsL3)  # "ResultingSortedList[]..[]"
