# Dynamo custom node SortingSetofLinesbyBestFit.dyf (Dynamo 2.2.1.5175)
# category: PracticalBIM.CADImports
# Sorts a Set of Lines by Best Fit

listoflinesunsorted = Input(listoflinesunsorted: Autodesk.DesignScript.Geometry.Line[])
flatten = List.Flatten(list=listoflinesunsorted)
startPoint = Curve.StartPoint(curve=flatten)
byBestFitThroughPoints = Line.ByBestFitThroughPoints(bestFitPoints=startPoint)
closestPointTo = Geometry.ClosestPointTo(geometry=byBestFitThroughPoints, other=startPoint)
startPoint_2 = Curve.StartPoint(curve=byBestFitThroughPoints)
distanceTo = Geometry.DistanceTo(geometry=closestPointTo, other=startPoint_2)
sort = List.Sort(list=distanceTo)
indexOf = List.IndexOf(list=distanceTo, element=sort)
getItemAtIndex = List.GetItemAtIndex(list=startPoint, index=indexOf)
byPoints = NurbsCurve.ByPoints(points=getItemAtIndex)
resultingline = Output(byPoints)  # "resultingline:NurbsCurve"
