# Dynamo custom node SortingandGroupingOFOPoints.dyf (Dynamo 2.2.1.5175)
# category: PracticalBIM.Revit.Elements.MEP.RoutingGrids
# Sorts and Groups Original Points Fixed Points and Oline Points

startpointsclose = Input(startpointsclose: Autodesk.DesignScript.Geometry.Point[])
sortingkeys = Input(sortingkeys: var[])
sorted_keys = List.Flatten(list=sortingkeys)
uniqueItems = List.UniqueItems(list=sorted_keys)
on_main_start_points = List.GetItemAtIndex(list=startpointsclose, index=uniqueItems)
onmainstartpoints = Output(on_main_start_points)  # "onmainstartpoints:Point[]"
originalpoints = Input(originalpoints: Autodesk.DesignScript.Geometry.Point[])
original_points = List.Flatten(list=originalpoints)
X = Point.X(point=original_points)
Y = Point.Y(point=original_points)
onlinepoints = Input(onlinepoints: Autodesk.DesignScript.Geometry.Point[])
online_points = List.Flatten(list=onlinepoints)
Z = Point.Z(point=online_points)
point_up = Point.ByCoordinates(x=X, y=Y, z=Z)
listtolabel = Input(listtolabel: var[])
string = StringInput("B")
labelingNumberofElements = Custom[LabelingNumberofElements](list=listtolabel, LabelStartText=string)  # Creates Labels From a Number of Elements
getItemAtIndex = List.GetItemAtIndex(list=labelingNumberofElements, index=sorted_keys)
grouped_fixed_original_points = List.GroupByKey(list=point_up, keys=getItemAtIndex)
groupsoffixedpoints = Output(grouped_fixed_original_points.groups)  # "groupsoffixedpoints:Point[]"
grouped_original_points = List.GroupByKey(list=original_points, keys=getItemAtIndex)
groupsoforiginalpoints = Output(grouped_original_points.groups)  # "groupsoforiginalpoints:Point[]"
grouped_online_points = List.GroupByKey(list=online_points, keys=getItemAtIndex)
groupsofonlinepoints = Output(grouped_online_points.groups)  # "groupsofonlinepoints:Point[]"
