# Dynamo custom node SortingofPointsfromtxtfileextract.dyf (Dynamo 2.2.1.5175)
# category: PracticalBIM.ImportExport.TXT
# Sorts the points from a txt file extract

listXYZUnsorted = Input(listXYZUnsorted: var[]..[])
transpose = List.Transpose(lists=listXYZUnsorted)
code_block = CodeBlock { 0; }
getItemAtIndex = List.GetItemAtIndex(list=transpose, index=code_block)
code_block_2 = CodeBlock { 1; }
getItemAtIndex_2 = List.GetItemAtIndex(list=transpose, index=code_block_2)
code_block_3 = CodeBlock { 2; }
getItemAtIndex_3 = List.GetItemAtIndex(list=transpose, index=code_block_3)
code_block_4 = CodeBlock(a=getItemAtIndex, b=getItemAtIndex_2, c=getItemAtIndex_3) { a+","+b+","+c+"!"; }
toNumber = String.ToNumber(str=getItemAtIndex)
toNumber_2 = String.ToNumber(str=getItemAtIndex_2)
toNumber_3 = String.ToNumber(str=getItemAtIndex_3)
list_create = List.Create(item0=code_block_4, item1=toNumber, item2=toNumber_2, item3=toNumber_3)
code_block_5 = CodeBlock { 1; }
code_block_6 = CodeBlock { 2; }
code_block_7 = CodeBlock { 3; }
sortListofListsL3 = Custom[SortListofListsL3](seq=list_create, sortIndex1=code_block_5, sortIndex2=code_block_6, sortIndex3=code_block_7)  # Sort Three levels of Lists by index
code_block_8 = CodeBlock(a=sortListofListsL3) { a[1]; }
XPoint = Output(code_block_8)  # "XPoint:double[]"
code_block_9 = CodeBlock(a=sortListofListsL3) { a[2]; }
YPoint = Output(code_block_9)  # "YPoint:double[]"
code_block_10 = CodeBlock(a=sortListofListsL3) { a[3]; }
ZPoint = Output(code_block_10)  # "ZPoint:double[]"
