# Dynamo custom node SplitCurvebyLengthEvenSides.dyf (Dynamo 2.6.1.8786)
# category: PracticalBIM.GD.Splits
# Splits a Curve by a Length using even sides and the remainder at the center

curve = Input(curve: Autodesk.DesignScript.Geometry.Curve)
length = Curve.Length(curve=curve)
ModuleLength = Input(ModuleLength: double)
code_block = CodeBlock(a=length, b=ModuleLength) { a/b; }
floor = Math.Floor(number=code_block)
code_block_2 = CodeBlock(a=floor) { a/2; }
floor_2 = Math.Floor(number=code_block_2)
code_block_3 = CodeBlock(b=floor_2, c=ModuleLength) { 0..#b+1..c; }
code_block_4 = CodeBlock(a=floor_2) { a*2; }
code_block_5 = CodeBlock(a=code_block_4, b=ModuleLength) { a*b; }
code_block_6 = CodeBlock(a=length, b=code_block_5) { a-b; }
code_block_7 = CodeBlock(a=code_block_6) { a/2; }
code_block_8 = CodeBlock(a=length) { a/2; }
code_block_9 = CodeBlock(a=code_block_7, b=code_block_8) { a+b; }
code_block_10 = CodeBlock(a=code_block_9, b=floor_2, c=ModuleLength) { a..#b..c; }
join = List.Join(list0=code_block_3, list1=code_block_10)
pointAtSegmentLength = Curve.PointAtSegmentLength(curve=curve, segmentLength=join)
PointsofLocation = Output(pointAtSegmentLength)  # "PointsofLocation:Point[]"
