# Dynamo custom node SplitCurvebyaListofCombinationGreaterThan3.dyf (Dynamo 2.3.0.5885)
# category: PracticalBIM.GD.Selection
# Splits Curves by a List of Combinations Greater Than 3 and Adapt Maximum Split to a Distance of Modules
# packages: PracticalBIM 2020.0.28

CountofElements = Input(CountofElements: int[])
code_block = CodeBlock { 4; }
ge = CountofElements >= code_block
code_block_2 = CodeBlock { true; }
allIndicesOf = List.AllIndicesOf(list=ge, item=code_block_2)
SelectedElements = Output(allIndicesOf)  # "SelectedElements:int"
ListofItems = Input(ListofItems: double[]..[])
getItemAtIndex = List.GetItemAtIndex(list=ListofItems, index=allIndicesOf)
code_block_3 = CodeBlock { 1; }
removeNItemsBeginEnd = Custom[RemoveNItemsBeginEnd](list=getItemAtIndex, numbertoremove=code_block_3)  # package PracticalBIM; Removes a Number of Items from the Begining and from End
ResultingItemsComb = Output(removeNItemsBeginEnd)  # "ResultingItemsComb:int"
ListofCurves = Input(ListofCurves: Autodesk.DesignScript.Geometry.Curve[])
getItemAtIndex_2 = List.GetItemAtIndex(list=ListofCurves, index=allIndicesOf)
lastItem = List.LastItem(list=getItemAtIndex@L2)
TotalFinalLength = Input(TotalFinalLength: double[])
TotalPropousedLength = Input(TotalPropousedLength: double[])
code_block_4 = CodeBlock(a=TotalFinalLength, b=TotalPropousedLength) { a-b; }
getItemAtIndex_3 = List.GetItemAtIndex(list=code_block_4, index=allIndicesOf)
code_block_5 = CodeBlock(a=lastItem, b=getItemAtIndex_3) { a+b; }
firstItem = List.FirstItem(list=getItemAtIndex@L2)
count = List.Count(list=removeNItemsBeginEnd@L2)
code_block_6 = CodeBlock(n=count) { 0..n-1..1; }
code_block_7 = CodeBlock(n=code_block_6) { 0..n..1; }
getItemAtIndex_4 = List.GetItemAtIndex(list=removeNItemsBeginEnd@L2, index=code_block_7@L3)
sum = Math.Sum(values=getItemAtIndex_4)
LimitofDistance = Input(LimitofDistance: double)
gt = sum > LimitofDistance
code_block_8 = CodeBlock { true; }
allIndicesOf_2 = List.AllIndicesOf(list=gt@L2, item=code_block_8)
getItemAtIndex_5 = List.GetItemAtIndex(list=removeNItemsBeginEnd, index=allIndicesOf_2, lacing=Shortest)
code_block_9 = CodeBlock { false; }
allIndicesOf_3 = List.AllIndicesOf(list=gt@L2, item=code_block_9)
lastItem_2 = List.LastItem(list=allIndicesOf_3@L2)
getItemAtIndex_6 = List.GetItemAtIndex(list=sum, index=lastItem_2, lacing=Shortest)
addItemToEnd = List.AddItemToEnd(item=getItemAtIndex_5, list=getItemAtIndex_6, lacing=Shortest)
code_block_10 = CodeBlock { 1; }
flatten = List.Flatten(list=addItemToEnd@L2, amt=code_block_10)
clean = List.Clean(list=flatten)
addItemToFront = List.AddItemToFront(item=firstItem, list=clean, lacing=Shortest)
addItemToEnd_2 = List.AddItemToEnd(item=code_block_5, list=addItemToFront, lacing=Shortest)
count_2 = List.Count(list=addItemToEnd_2@L2)
code_block_11 = CodeBlock(n=count_2) { 0..n-1..1; }
code_block_12 = CodeBlock(n=code_block_11) { 0..n..1; }
getItemAtIndex_7 = List.GetItemAtIndex(list=addItemToEnd_2@L2, index=code_block_12@L3)
sum_2 = Math.Sum(values=getItemAtIndex_7)
pointAtSegmentLength = Curve.PointAtSegmentLength(curve=getItemAtIndex_2, segmentLength=sum_2)
splitByPoints = Curve.SplitByPoints(curve=getItemAtIndex_2, points=pointAtSegmentLength)
ResultingCurves = Output(splitByPoints)  # "ResultingCurves:Curve"
