# Dynamo custom node SplitDuctbyNumberofElements.dyf (Dynamo 2.2.1.5175)
# category: PracticalBIM.Revit.Elements.MEP.Ducts
# Splits any Ducts by thier Number of Elements

Ducttobesplitted = Input(Ducttobesplitted: Revit.Elements.Element)
numberofsplits = Input(numberofsplits: double)
list_create = List.Create(item0=Ducttobesplitted, item1=numberofsplits)
start = Revit.Transaction.Transaction.Start(input=list_create)
code_block = CodeBlock { 0; }
getItemAtIndex = List.GetItemAtIndex(list=start, index=code_block)
getLocation = Element.GetLocation(element=getItemAtIndex)
code_block_2 = CodeBlock { 1; }
getItemAtIndex_2 = List.GetItemAtIndex(list=start, index=code_block_2)
code_block_3 = CodeBlock(n=getItemAtIndex_2) { 0..1..#n+1; }
restOfItems = List.RestOfItems(list=code_block_3)
removeLast = Custom[RemoveLast](list=restOfItems)  # Remove Last element of a List
pointAtParameter = Curve.PointAtParameter(curve=getLocation, param=removeLast)
splitByPoints = Curve.SplitByPoints(curve=getLocation, points=pointAtParameter)
createDuctbyLineandDuctRectangular = Custom[CreateDuctbyLineandDuctRectangular](Ductelement=getItemAtIndex, DuctLines=splitByPoints)  # Creates a Duct from Lines and a Duct element properties Rectangular
list_create_2 = List.Create(item0=getItemAtIndex, item1=createDuctbyLineandDuctRectangular)
end = Revit.Transaction.Transaction.End(input=list_create_2)
code_block_4 = CodeBlock { 0; }
getItemAtIndex_3 = List.GetItemAtIndex(list=end, index=code_block_4)
deleteListofElements = Custom[DeleteListofElements](list=getItemAtIndex_3)  # Deletes a List of Elements
Result = Output(deleteListofElements)
code_block_5 = CodeBlock { 1; }
getItemAtIndex_4 = List.GetItemAtIndex(list=end, index=code_block_5)
RectangularSplittedDucts = Output(getItemAtIndex_4)  # "RectangularSplittedDucts:var[]"
