# Dynamo custom node SplitLinebyaGivenLengthwithEvenRemainder.dyf (Dynamo 2.3.0.5885)
# category: PracticalBIM.GD.Splits
# Splits the Line by a Given Length with a Even Remainder

CurvetoDivide = Input(CurvetoDivide: Autodesk.DesignScript.Geometry.Curve[])
valueselected = Input(valueselected: double[])
code_block = CodeBlock(a=valueselected) { a/2; }
totallength = Input(totallength: double[])
numberofelements = Input(numberofelements: int[])
code_block_2 = CodeBlock(a=valueselected, b=numberofelements) { a*b; }
code_block_3 = CodeBlock(a=totallength, b=code_block_2) { a-b; }
code_block_4 = CodeBlock(a=numberofelements) { a+1; }
code_block_5 = CodeBlock(a=code_block_3, b=code_block_4) { a/b; }
code_block_6 = CodeBlock(a=code_block, b=code_block_5) { a+b; }
code_block_7 = CodeBlock(a=code_block_5, b=valueselected) { a+b; }
code_block_8 = CodeBlock(a=code_block_6, b=numberofelements, c=code_block_7) { a..#b..c; }
pointAtSegmentLength = Curve.PointAtSegmentLength(curve=CurvetoDivide, segmentLength=code_block_8)
Point = Output(pointAtSegmentLength)
