# Dynamo custom node SplitLinebyaGivenLengthwithEvenRemainderandSEOffset.dyf (Dynamo 2.3.0.5885)
# category: PracticalBIM.GD.Splits
# Splits a line by a Given Length with Even Remainder and Start and End Offset

CurvetoDivide = Input(CurvetoDivide: Autodesk.DesignScript.Geometry.Curve[])
code_block = CodeBlock { 3; }
valueselected = Input(valueselected: double[])
code_block_2 = CodeBlock(a=valueselected) { a/2; }
code_block_3 = CodeBlock(a=code_block, b=code_block_2) { a+b; }
numberofelements = Input(numberofelements: int[])
totallength = Input(totallength: double[])
code_block_4 = CodeBlock(a=valueselected, b=numberofelements) { a*b; }
code_block_5 = CodeBlock(a=totallength, b=code_block_4) { a-b; }
code_block_6 = CodeBlock(a=code_block) { a*2; }
code_block_7 = CodeBlock(a=code_block_5, b=code_block_6) { a-b; }
code_block_8 = CodeBlock(a=numberofelements) { a-1; }
code_block_9 = CodeBlock(a=code_block_7, b=code_block_8) { a/b; }
code_block_10 = CodeBlock(a=code_block_9, b=valueselected) { a+b; }
code_block_11 = CodeBlock(a=code_block_3, b=numberofelements, c=code_block_10) { a..#b..c; }
pointAtSegmentLength = Curve.PointAtSegmentLength(curve=CurvetoDivide, segmentLength=code_block_11)
DivisionPoints = Output(pointAtSegmentLength)  # "DivisionPoints:Point[]"
