# Dynamo custom node SplitLinesbyGivenListofLengthMax3.dyf (Dynamo 2.3.0.5885)
# category: PracticalBIM.GD.Splits
# Splits Lines by a given List of length with a set of three

CurveLengthstoDivide = Input(CurveLengthstoDivide: double[])
LengthsofLists = Input(LengthsofLists: double[])
selectbyGivenLengthDistanceWithLesserRem = Custom[SelectbyGivenLengthDistanceWithLesserRemainder](curveliststodivide=CurveLengthstoDivide, LengthsofLists=LengthsofLists)  # Selects by a Given Length a Distance with the Smallest Remainder
selectbyGivenLengthDistanceWithLesserRem_2 = Custom[SelectbyGivenLengthDistanceWithLesserRemainder](curveliststodivide=selectbyGivenLengthDistanceWithLesserRem.remainder, LengthsofLists=LengthsofLists)
clearNullsofRemainder = Custom[ClearNullsofRemainder](remainders=selectbyGivenLengthDistanceWithLesserRem_2.remainder, previousremainders=selectbyGivenLengthDistanceWithLesserRem.remainder, lacing=Shortest)  # Clears all Nulls of Remainder by another Remainder
flatten = List.Flatten(list=clearNullsofRemainder)
selectbyGivenLengthDistanceWithLesserRem_3 = Custom[SelectbyGivenLengthDistanceWithLesserRemainder](curveliststodivide=flatten, LengthsofLists=LengthsofLists)
list_create = List.Create(item0=selectbyGivenLengthDistanceWithLesserRem.selectedelement, item1=selectbyGivenLengthDistanceWithLesserRem_2.selectedelement, item2=selectbyGivenLengthDistanceWithLesserRem_3.selectedelement)
transpose = List.Transpose(lists=list_create)
code_block = CodeBlock { -1; }
eq = transpose == code_block
code_block_2 = CodeBlock { true; }
allIndicesOf = List.AllIndicesOf(list=eq@L2, item=code_block_2)
removeItemAtIndex = List.RemoveItemAtIndex(list=transpose@L2, indices=allIndicesOf@L2)
listofelements = Output(removeItemAtIndex)  # "listofelements:int[]..[]"
clearNullsofRemainder_2 = Custom[ClearNullsofRemainder](remainders=selectbyGivenLengthDistanceWithLesserRem_3.remainder, previousremainders=flatten, lacing=Shortest)
flatten_2 = List.Flatten(list=clearNullsofRemainder_2)
remainder = Output(flatten_2)  # "remainder:double[]"
