# Dynamo custom node SplitLinesbyGivenListofLengthsEqualMultipler.dyf (Dynamo 2.3.0.5885)
# category: PracticalBIM.GD.Splits
# Split A line by a given list of Lengths Equals to Multipler elements

CurveLengthstodivide = Input(CurveLengthstodivide: double[])
LengthsofLists = Input(LengthsofLists: double[])
div = CurveLengthstodivide / LengthsofLists  # lacing=CrossProduct
floor = Math.Floor(number=div)
transpose = List.Transpose(lists=floor)
mul = LengthsofLists * transpose@L2  # lacing=Shortest
transpose_2 = List.Transpose(lists=mul)
sub = CurveLengthstodivide - transpose_2
minimumItem = List.MinimumItem(list=sub@L2)
allIndicesOf = List.AllIndicesOf(list=sub@L2, item=minimumItem@L1)
getItemAtIndex = List.GetItemAtIndex(list=floor@L2, index=allIndicesOf@L2)
string_from_object = FromObject(obj=getItemAtIndex)
minimumItem_2 = List.MinimumItem(list=string_from_object)
indexOf = List.IndexOf(list=string_from_object, element=minimumItem_2, lacing=Shortest)
getItemAtIndex_2 = List.GetItemAtIndex(list=allIndicesOf@L2, index=indexOf, lacing=Shortest)
getItemAtIndex_3 = List.GetItemAtIndex(list=LengthsofLists, index=getItemAtIndex_2)
toNumber = String.ToNumber(str=minimumItem_2)
code_block = CodeBlock(a=getItemAtIndex_3, b=toNumber) { a*b; }
code_block_2 = CodeBlock(a=CurveLengthstodivide, b=code_block) { a-b; }
Remainderdistance = Output(code_block_2)  # "Remainderdistance:double"
indextouse = Output(getItemAtIndex_2)  # "indextouse:int[]"
timetouse = Output(toNumber)  # "timetouse:int[]"
