# Dynamo custom node SplitLinesbyGivenListwithLongestLength.dyf (Dynamo 2.3.0.5885)
# category: PracticalBIM.GD.Splits
# Splits a Line by a Given List with a Longest Length
# packages: PracticalBIM 2020.0.26

LengthsofElements = Input(LengthsofElements: double[])
LengthstoDivide = Input(LengthstoDivide: double[])
SpaceFactor = Input(SpaceFactor: double)
code_block = CodeBlock(a=LengthsofElements, b=SpaceFactor) { a*b; }
div = LengthstoDivide / code_block  # lacing=CrossProduct
floor = Math.Floor(number=div)
string_from_object = FromObject(obj=floor)
minimumItem = List.MinimumItem(list=floor)
string_from_object_2 = FromObject(obj=minimumItem)
numberStringWithoutDecimals = Custom[NumberStringWithoutDecimals](str=string_from_object_2)  # package PracticalBIM; Gives a Number string with out decimals
allIndicesOf = List.AllIndicesOf(list=string_from_object@L2, item=numberStringWithoutDecimals@L1)
transpose = List.Transpose(lists=floor)
code_block_2 = CodeBlock(a=code_block, b=transpose) { a*b; }
transpose_2 = List.Transpose(lists=code_block_2)
sub = LengthstoDivide - transpose_2
getItemAtIndex = List.GetItemAtIndex(list=sub@L2, index=allIndicesOf@L2)
minimumItem_2 = List.MinimumItem(list=getItemAtIndex@L2)
indexOf = List.IndexOf(list=getItemAtIndex@L2, element=minimumItem_2@L1)
getItemAtIndex_2 = List.GetItemAtIndex(list=allIndicesOf@L2, index=indexOf@L1)
getItemAtIndex_3 = List.GetItemAtIndex(list=LengthsofElements, index=getItemAtIndex_2)
valuesselected = Output(getItemAtIndex_3)  # "valuesselected:double[]"
getItemAtIndex_4 = List.GetItemAtIndex(list=floor@L2, index=getItemAtIndex_2@L1)
numberofelements = Output(getItemAtIndex_4)  # "numberofelements:int[]"
