# Dynamo custom node SplitLinesbyLengthandOffsetFromStart.dyf (Dynamo 2.5.0.7460)
# category: PracticalBIM.GD.Splits
# Splits Lines by a Length and Offset From Start

geometrycurve = Input(geometrycurve: Autodesk.DesignScript.Geometry.Curve[])
curvelength = Input(curvelength: double[])
splitlength = Input(splitlength: double)
offsetlength = Input(offsetlength: double)
code_block = CodeBlock(a=splitlength, b=offsetlength) { a-b; }
code_block_2 = CodeBlock(a=curvelength, b=code_block) { a/b; }
ceiling = Math.Ceiling(number=code_block_2)
code_block_3 = CodeBlock(a=ceiling, b=code_block) { 0..#a..b; }
pointAtSegmentLength = Curve.PointAtSegmentLength(curve=geometrycurve, segmentLength=code_block_3)
code_block_4 = CodeBlock(a=splitlength, b=ceiling, c=code_block) { a..#b..c; }
code_block_5 = CodeBlock(a=ceiling) { a-1; }
replaceItemAtIndex = List.ReplaceItemAtIndex(list=code_block_4@L2, index=code_block_5@L1, item=curvelength@L1)
pointAtSegmentLength_2 = Curve.PointAtSegmentLength(curve=geometrycurve, segmentLength=replaceItemAtIndex)
byStartPointEndPoint = Line.ByStartPointEndPoint(startPoint=pointAtSegmentLength, endPoint=pointAtSegmentLength_2)
splittedLines = Output(byStartPointEndPoint)  # "splittedLines:Autodesk.Curve[]"
length = Curve.Length(curve=byStartPointEndPoint)
lengths = Output(length)  # "lengths:double[]"
