# Dynamo custom node SplitLinesbyLengthandOffsetMiddle.dyf (Dynamo 2.5.0.7460)
# category: PracticalBIM.GD.Splits
# Splits a Line by a given Length with and Offset from Middle

curve = Input(curve: Autodesk.DesignScript.Geometry.Curve[])
curvelength = Input(curvelength: double[])
length = Input(length: double)
offset = Input(offset: double)
code_block = CodeBlock(a=length, b=offset) { a-b; }
code_block_2 = CodeBlock(a=curvelength, b=code_block) { a/b; }
ceiling = Math.Ceiling(number=code_block_2)
code_block_3 = CodeBlock(a=ceiling) { a/2; }
code_block_4 = CodeBlock(a=code_block_3, b=code_block) { a*-b; }
code_block_5 = CodeBlock(a=curvelength) { a/2; }
code_block_6 = CodeBlock(a=code_block_4, b=code_block_5) { a+b; }
code_block_7 = CodeBlock(a=code_block_6, b=ceiling, c=code_block) { a..#b..c; }
code_block_8 = CodeBlock { 0; }
code_block_9 = CodeBlock { 0; }
replaceItemAtIndex = List.ReplaceItemAtIndex(list=code_block_7@L2, index=code_block_8@L1, item=code_block_9@L1)
pointAtSegmentLength = Curve.PointAtSegmentLength(curve=curve, segmentLength=replaceItemAtIndex)
code_block_10 = CodeBlock(a=code_block_6, b=length) { a+b; }
code_block_11 = CodeBlock(a=code_block_10, b=ceiling, c=code_block) { a..#b..c; }
code_block_12 = CodeBlock(a=ceiling) { a-1; }
replaceItemAtIndex_2 = List.ReplaceItemAtIndex(list=code_block_11@L2, index=code_block_12@L1, item=curvelength@L1)
pointAtSegmentLength_2 = Curve.PointAtSegmentLength(curve=curve, segmentLength=replaceItemAtIndex_2)
byStartPointEndPoint = Line.ByStartPointEndPoint(startPoint=pointAtSegmentLength, endPoint=pointAtSegmentLength_2)
splittedLines = Output(byStartPointEndPoint)  # "splittedLines:Autodesk.Curve[]"
length_2 = Curve.Length(curve=byStartPointEndPoint)
lengths = Output(length_2)  # "lengths:double[]"
