# Dynamo custom node SplitSetofPointsforMultipleFloors.dyf (Dynamo 2.2.1.5175)
# category: PracticalBIM.Geometry.Surfaces
# Creates a Split set of Points for Multiple Floor Creation

curve = Input(curve: Autodesk.DesignScript.Geometry.Curve)
points = Input(points: Autodesk.DesignScript.Geometry.Point[])
splitByPoints = Curve.SplitByPoints(curve=curve, points=points)
startPoint = Curve.StartPoint(curve=splitByPoints)
code_block = CodeBlock { 0.3; }
pointAtParameter = Curve.PointAtParameter(curve=splitByPoints, param=code_block)
code_block_2 = CodeBlock { 0.6; }
pointAtParameter_2 = Curve.PointAtParameter(curve=splitByPoints, param=code_block_2)
endPoint = Curve.EndPoint(curve=splitByPoints)
list_create = List.Create(item0=startPoint, item1=pointAtParameter, item2=pointAtParameter_2, item3=endPoint)
transpose = List.Transpose(lists=list_create)
Points2 = Output(transpose)  # "Points2:Point[]"
curve_2 = Input(curve: Autodesk.DesignScript.Geometry.Curve)
points_2 = Input(points: Autodesk.DesignScript.Geometry.Point[])
splitByPoints_2 = Curve.SplitByPoints(curve=curve_2, points=points_2)
startPoint_2 = Curve.StartPoint(curve=splitByPoints_2)
pointAtParameter_3 = Curve.PointAtParameter(curve=splitByPoints_2, param=code_block, lacing=CrossProduct)
pointAtParameter_4 = Curve.PointAtParameter(curve=splitByPoints_2, param=code_block_2, lacing=CrossProduct)
endPoint_2 = Curve.EndPoint(curve=splitByPoints_2)
list_create_2 = List.Create(item0=startPoint_2, item1=pointAtParameter_3, item2=pointAtParameter_4, item3=endPoint_2)
transpose_2 = List.Transpose(lists=list_create_2)
Points1 = Output(transpose_2)  # "Points1:Point[]"
