# Dynamo custom node SplitSolidbyPlanes.dyf (Dynamo 2.2.1.5175)
# category: PracticalBIM.Splitting
# Splits a Solid element by Planes sorted

solidtodivide = Input(solidtodivide: Autodesk.DesignScript.Geometry.Solid)
planesfordivision = Input(planesfordivision: Autodesk.DesignScript.Geometry.Plane[])
split = Geometry.Split(geometry=solidtodivide, other=planesfordivision, lacing=CrossProduct)
lastItem = List.LastItem(list=split)
firstItem = List.FirstItem(list=split)
area = Solid.Area(solid=firstItem)
maximumItem = List.MaximumItem(list=area)
firstIndexOf = List.FirstIndexOf(list=area, item=maximumItem)
lastSurfaceSplitted = List.GetItemAtIndex(list=lastItem, index=firstIndexOf)
minimumItem = List.MinimumItem(list=area)
firstIndexOf_2 = List.FirstIndexOf(list=area, item=minimumItem)
firstSurfaceSplitted = List.GetItemAtIndex(list=firstItem, index=firstIndexOf_2)
code_block = CodeBlock { 0; }
eq = firstIndexOf == code_block
restOfItems = List.RestOfItems(list=split)
selectedSurfaces = List.GetItemAtIndex(list=restOfItems@L2, index=firstIndexOf_2)
split_2 = Geometry.Split(geometry=selectedSurfaces, other=planesfordivision, lacing=Shortest)
removeLast = Custom[RemoveLast](list=split_2@L2)  # Remove Last element of a List
restOfItems_2 = List.RestOfItems(list=split_2@L2)
if_ = If(test=eq, true=removeLast, false=restOfItems_2)
flatten = List.Flatten(list=if_)
addItemToFront = List.AddItemToFront(item=firstSurfaceSplitted, list=flatten)
addItemToEnd = List.AddItemToEnd(item=lastSurfaceSplitted, list=addItemToFront)
resultingsolid = Output(addItemToEnd)  # "resultingsolid:Solid[]"
