# Dynamo custom node SplitSolidwithSeriesofSurfaces.dyf (Dynamo 2.2.1.5175)
# category: PracticalBIM.Geometry.Modifiers
# Splits a Solid by a Series of Surfaces

objecttosplit = Input(objecttosplit: Autodesk.DesignScript.Geometry.Geometry)
SplittingSurfaces = Input(SplittingSurfaces: Autodesk.DesignScript.Geometry.Surface[])
split = Geometry.Split(geometry=objecttosplit, other=SplittingSurfaces)
code_block = CodeBlock { false; }
getLowerZSolidfromSplit = Custom[GetLowerZSolidfromSplit](solid=split, inverse=code_block)  # Get the Lower Z Volume from centroid from a Split
getItemAtIndex = List.GetItemAtIndex(list=split@L2, index=getLowerZSolidfromSplit, lacing=Shortest)
flatten = List.Flatten(list=getItemAtIndex)
count = List.Count(list=flatten)
code_block_2 = CodeBlock(a=count) { a-1; }
getItemAtIndex_2 = List.GetItemAtIndex(list=flatten, index=code_block_2)
restOfItems = List.RestOfItems(list=SplittingSurfaces)
split_2 = Geometry.Split(geometry=flatten, other=restOfItems, lacing=Shortest)
code_block_3 = CodeBlock { true; }
getLowerZSolidfromSplit_2 = Custom[GetLowerZSolidfromSplit](solid=split_2, inverse=code_block_3)
getItemAtIndex_3 = List.GetItemAtIndex(list=split_2@L2, index=getLowerZSolidfromSplit_2, lacing=Shortest)
flatten_2 = List.Flatten(list=getItemAtIndex_3)
addItemToEnd = List.AddItemToEnd(item=getItemAtIndex_2, list=flatten_2)
resultingSolids = Output(addItemToEnd)  # "resultingSolids:Solid[]"
