# Dynamo custom node SplitSurfacebyLines.dyf (Dynamo 2.2.1.5175)
# category: PracticalBIM.Splitting
# Splits a Surface by a list of lines

surfacetodivide = Input(surfacetodivide: Autodesk.DesignScript.Geometry.Surface)
linesfordivision = Input(linesfordivision: Autodesk.DesignScript.Geometry.Curve[])
code_block = CodeBlock { 1; }
removeNItemsBeginEnd = Custom[RemoveNItemsBeginEnd](list=linesfordivision, numbertoremove=code_block)  # Removes a Number of Items from the Begining and from End
split = Geometry.Split(geometry=surfacetodivide, other=removeNItemsBeginEnd, lacing=CrossProduct)
lastItem = List.LastItem(list=split)
firstItem = List.FirstItem(list=split)
area = Surface.Area(surface=firstItem)
maximumItem = List.MaximumItem(list=area)
firstIndexOf = List.FirstIndexOf(list=area, item=maximumItem)
lastSurfaceSplitted = List.GetItemAtIndex(list=lastItem, index=firstIndexOf)
minimumItem = List.MinimumItem(list=area)
firstIndexOf_2 = List.FirstIndexOf(list=area, item=minimumItem)
firstSurfaceSplitted = List.GetItemAtIndex(list=firstItem, index=firstIndexOf_2)
code_block_2 = CodeBlock { 0; }
eq = firstIndexOf == code_block_2
restOfItems = List.RestOfItems(list=split)
selectedSurfaces = List.GetItemAtIndex(list=restOfItems@L2, index=firstIndexOf_2)
split_2 = Geometry.Split(geometry=selectedSurfaces, other=removeNItemsBeginEnd, lacing=Shortest)
removeLast = Custom[RemoveLast](list=split_2@L2)  # Remove Last element of a List
restOfItems_2 = List.RestOfItems(list=split_2@L2)
if_ = If(test=eq, true=removeLast, false=restOfItems_2)
flatten = List.Flatten(list=if_)
addItemToFront = List.AddItemToFront(item=firstSurfaceSplitted, list=flatten)
addItemToEnd = List.AddItemToEnd(item=lastSurfaceSplitted, list=addItemToFront)
resultingsurfaces = Output(addItemToEnd)  # "resultingsurfaces:Surface[]"
