# Dynamo custom node SquareModulefromCoordinateSystemandXY.dyf (Dynamo 2.2.1.5175)
# category: PracticalBIM.Geometry.Structure.Modules
# Gives an square module of elements from a offset

cs = Input(cs: Autodesk.DesignScript.Geometry.CoordinateSystem[])
upperlimit = Input(upperlimit: double)
lowerlimit = Input(lowerlimit: double)
byCartesianCoordinates = Point.ByCartesianCoordinates(cs=cs, x=upperlimit, y=lowerlimit)
linesFromListofPoints = Custom[LinesFromListofPoints](list=byCartesianCoordinates)  # Gets a secuence of Lines from a list of Points
byCartesianCoordinates_2 = Point.ByCartesianCoordinates(cs=cs, x=upperlimit, y=upperlimit)
linesFromListofPoints_2 = Custom[LinesFromListofPoints](list=byCartesianCoordinates_2)
byCartesianCoordinates_3 = Point.ByCartesianCoordinates(cs=cs, x=lowerlimit, y=lowerlimit)
linesFromListofPoints_3 = Custom[LinesFromListofPoints](list=byCartesianCoordinates_3)
byCartesianCoordinates_4 = Point.ByCartesianCoordinates(cs=cs, x=lowerlimit, y=upperlimit)
linesFromListofPoints_4 = Custom[LinesFromListofPoints](list=byCartesianCoordinates_4)
list_create = List.Create(item0=linesFromListofPoints, item1=linesFromListofPoints_2, item2=linesFromListofPoints_3, item3=linesFromListofPoints_4)
transversallines = Output(list_create)  # "transversallines:Curve[]..[]"
byStartPointEndPoint = Line.ByStartPointEndPoint(startPoint=byCartesianCoordinates, endPoint=byCartesianCoordinates_2)
byStartPointEndPoint_2 = Line.ByStartPointEndPoint(startPoint=byCartesianCoordinates_2, endPoint=byCartesianCoordinates_4)
byStartPointEndPoint_3 = Line.ByStartPointEndPoint(startPoint=byCartesianCoordinates_4, endPoint=byCartesianCoordinates_3)
byStartPointEndPoint_4 = Line.ByStartPointEndPoint(startPoint=byCartesianCoordinates_3, endPoint=byCartesianCoordinates)
list_create_2 = List.Create(item0=byStartPointEndPoint, item1=byStartPointEndPoint_2, item2=byStartPointEndPoint_3, item3=byStartPointEndPoint_4)
sectionlines = Output(list_create_2)  # "sectionlines:Curve[]..[]"
