# Dynamo custom node StationZValuesFromSlopeandRequiredHeigth.dyf (Dynamo 2.2.1.5175)
# category: PracticalBIM.Geometry.Solids
# Set up the Heigth of Station Points by Slope and Required Heigth

StationPoints = Input(StationPoints: Autodesk.DesignScript.Geometry.Point[])
Z = Point.Z(point=StationPoints)
maximumItem = List.MaximumItem(list=Z)
code_block = CodeBlock { 2; }
round = Math.Round(number=maximumItem, digits=code_block)
requiredheigth = Input(requiredheigth: double)
code_block_2 = CodeBlock(a=round, b=requiredheigth) { a+b; }
curvelength = Input(curvelength: double)
slope = Input(slope: double)
code_block_3 = CodeBlock(a=curvelength, b=slope) { a*b; }
code_block_4 = CodeBlock(a=code_block_2, b=code_block_3) { a-b; }
count = List.Count(list=Z)
code_block_5 = CodeBlock(a=code_block_4, b=code_block_2, n=count) { a..b..#n; }
code_block_6 = CodeBlock(a=code_block_5, b=Z) { a-b; }
minimumItem = List.MinimumItem(list=code_block_6)
code_block_7 = CodeBlock(c=requiredheigth, b=minimumItem) { c-b; }
code_block_8 = CodeBlock(a=code_block_5, b=code_block_7) { a+b; }
ZValue = Output(code_block_8)  # "ZValue:double[]"
