# Dynamo custom node StirrupforColumnsPolycurveandlinefromSidesTopandBottomfaces.dyf (Dynamo 2.2.1.5175)
# category: PracticalBIM.Rebar.Geometry
# Creates Strirrup for Columns by faces creating polycurve and line.

bottomsurface = Input(bottomsurface: Autodesk.DesignScript.Geometry.Surface)
code_block = CodeBlock { 0.5; }
normalAtParameter = Surface.NormalAtParameter(surface=bottomsurface, u=code_block, v=code_block)
reverse = Vector.Reverse(vector=normalAtParameter)
Bottomdistance = Input(Bottomdistance: double)
translate = Geometry.Translate(geometry=bottomsurface, direction=reverse, distance=Bottomdistance)
smallsidesurface = Input(smallsidesurface: Autodesk.DesignScript.Geometry.Surface[])
code_block_2 = CodeBlock { 0.5; }
normalAtParameter_2 = Surface.NormalAtParameter(surface=smallsidesurface, u=code_block_2, v=code_block_2)
reverse_2 = Vector.Reverse(vector=normalAtParameter_2)
Otherfacesdistance = Input(Otherfacesdistance: double)
translate_2 = Geometry.Translate(geometry=smallsidesurface, direction=reverse_2, distance=Otherfacesdistance, lacing=Longest)
intersect = Geometry.Intersect(geometry=translate, other=translate_2, lacing=Longest)
flatten = List.Flatten(list=intersect)
longsidesurface = Input(longsidesurface: Autodesk.DesignScript.Geometry.Surface[])
code_block_3 = CodeBlock { 0.5; }
normalAtParameter_3 = Surface.NormalAtParameter(surface=longsidesurface, u=code_block_3, v=code_block_3)
reverse_3 = Vector.Reverse(vector=normalAtParameter_3)
translate_3 = Geometry.Translate(geometry=longsidesurface, direction=reverse_3, distance=Otherfacesdistance, lacing=Longest)
intersect_2 = Geometry.Intersect(geometry=translate, other=translate_3, lacing=Longest)
flatten_2 = List.Flatten(list=intersect_2)
intersect_3 = Geometry.Intersect(geometry=flatten, other=flatten_2, lacing=CrossProduct)
flatten_3 = List.Flatten(list=intersect_3)
code_block_4 = CodeBlock { [0,1,3,2]; }
getItemAtIndex = List.GetItemAtIndex(list=flatten_3, index=code_block_4)
byPerimeterPoints = Surface.ByPerimeterPoints(points=getItemAtIndex)
perimeterCurves = Surface.PerimeterCurves(surface=byPerimeterPoints)
byJoinedCurves = PolyCurve.ByJoinedCurves(curves=perimeterCurves)
stirupline = Output(byJoinedCurves)  # "stirupline:Line"
code_block_5 = CodeBlock { 0.5; }
pointAtParameter = Surface.PointAtParameter(surface=translate, u=code_block_5, v=code_block_5)
topsurface = Input(topsurface: Autodesk.DesignScript.Geometry.Surface)
normalAtParameter_4 = Surface.NormalAtParameter(surface=topsurface, u=code_block, v=code_block)
reverse_4 = Vector.Reverse(vector=normalAtParameter_4)
Topdistance = Input(Topdistance: double)
translate_4 = Geometry.Translate(geometry=topsurface, direction=reverse_4, distance=Topdistance)
pointAtParameter_2 = Surface.PointAtParameter(surface=translate_4, u=code_block_5, v=code_block_5)
byStartPointEndPoint = Line.ByStartPointEndPoint(startPoint=pointAtParameter, endPoint=pointAtParameter_2)
verticalline = Output(byStartPointEndPoint)  # "verticalline:Line"
