# Dynamo custom node StringfromDouble2Decimals.dyf (Dynamo 2.2.1.5175)
# category: PracticalBIM.Math
# Gives a String with Two decimals From Double

doublenumber = Input(doublenumber: double[])
string_from_object = FromObject(obj=doublenumber)
code_block = CodeBlock { 0; }
code_block_2 = CodeBlock { "."; }
indexOf = String.IndexOf(str=string_from_object, searchFor=code_block_2)
code_block_3 = CodeBlock(a=indexOf) { a+3; }
substring = String.Substring(str=string_from_object, startIndex=code_block, length=code_block_3)
DoubleString = Output(substring)  # "DoubleString:string[]"
