# Dynamo custom node StructuralColumnByNewGeometry.dyf (Dynamo 2.2.1.5175)
# category: PracticalBIM.Revit.Elements.StructuralColumns
# Creates Structural Columns with same properties as Original but Changing the Curves of Creation

curve = Input(curve: Autodesk.DesignScript.Geometry.Curve[])
level = Input(level: var[])
originalelement = Input(originalelement: Revit.Elements.Element)
code_block = CodeBlock { "Type"; }
getParameterValueByName = Element.GetParameterValueByName(element=originalelement, parameterName=code_block)
columnByCurve = StructuralFraming.ColumnByCurve(curve=curve, level=level, structuralColumnType=getParameterValueByName)
StructuralFraming = Output(columnByCurve)
