# Dynamo custom node StructuralFramingsByNewGeometry.dyf (Dynamo 2.2.1.5175)
# category: PracticalBIM.Revit.Elements.StructuralFramings
# Creates Structural Framings by New Geometry Provided

curve = Input(curve: Autodesk.DesignScript.Geometry.Curve[])
element = Input(element: Revit.Elements.Element)
code_block = CodeBlock { "Reference Level"; }
getParameterValueByName = Element.GetParameterValueByName(element=element, parameterName=code_block)
code_block_2 = CodeBlock { "Type"; }
getParameterValueByName_2 = Element.GetParameterValueByName(element=element, parameterName=code_block_2)
beamByCurve = StructuralFraming.BeamByCurve(curve=curve, level=getParameterValueByName, structuralFramingType=getParameterValueByName_2)
StructuralFraming = Output(beamByCurve)
