# Dynamo custom node Surfacefromsortedpointsatchop.dyf (Dynamo 2.2.1.5175)
# category: PracticalBIM.Geometry.Surfaces
# Creates a Surfaces using a list of points and a integer value of where as the value changes direction using aligned points

pointsofsurface = Input(pointsofsurface: Autodesk.DesignScript.Geometry.Point[])
lengths = Input(lengths: int)
chop = List.Chop(list=pointsofsurface, lengths=lengths)
byPoints = NurbsCurve.ByPoints(points=chop)
byLoft = Surface.ByLoft(crossSections=byPoints)
Surface = Output(byLoft)
