# Dynamo custom node TimeDurationProgression.dyf (Dynamo 2.6.1.8786)
# category: PracticalBIM.4dSimulation
# Set a Duration for List and amount of elements to be used
# packages: PracticalBIM 2020.0.37

item = Input(item: var[])
amount = Input(amount: int[])
ofRepeatedItem = List.OfRepeatedItem(item=item, amount=amount, lacing=Shortest)
code_block = CodeBlock(a=amount) { 1..#a+1..1; }
code_block_2 = CodeBlock(a=code_block) { 0..#a..1; }
removeLast = Custom[RemoveLast](list=code_block_2@L3)  # package PracticalBIM; Remove Last element of a List
getItemAtIndex = List.GetItemAtIndex(list=ofRepeatedItem@L2, index=removeLast@L3)
sum = Math.Sum(values=getItemAtIndex@L3)
code_block_3 = CodeBlock(a=sum, b=ofRepeatedItem) { a-b; }
StartValues = Output(code_block_3)
DurationValues = Output(ofRepeatedItem)
