# Dynamo custom node ToList.dyf (Dynamo 2.6.1.8786)
# category: PracticalBIM.Lists
# Turns a set of elements into one List

variousItems = Input(variousItems: var[]..[])
create = List.Create(item0=variousItems)
flatten = List.Flatten(list=create)
listsequence = Output(flatten)
