# Dynamo custom node TopographyPointstoCrossLines.dyf (Dynamo 2.2.1.5175)
# category: PracticalBIM.Revit.Elements.Topography
# Create Profile lines from a series of Points and a Distance Point

TopographyPoints = Input(TopographyPoints: Autodesk.DesignScript.Geometry.Point[])
Z = Point.Z(point=TopographyPoints)
PrecisionDigits = Input(PrecisionDigits: int)
round = Math.Round(number=Z, digits=PrecisionDigits)
groupByKey = List.GroupByKey(list=TopographyPoints, keys=round)
count = List.Count(list=groupByKey.groups@L2)
code_block = CodeBlock { 4; }
gt = count > code_block
code_block_2 = CodeBlock { true; }
allIndicesOf = List.AllIndicesOf(list=gt, item=code_block_2)
getItemAtIndex = List.GetItemAtIndex(list=groupByKey.groups, index=allIndicesOf)
getItemAtIndex_2 = List.GetItemAtIndex(list=groupByKey.unique_keys, index=allIndicesOf)
sort = List.Sort(list=getItemAtIndex_2)
indexOf = List.IndexOf(list=getItemAtIndex_2, element=sort)
getItemAtIndex_3 = List.GetItemAtIndex(list=getItemAtIndex, index=indexOf)
referencepoint = Input(referencepoint: Autodesk.DesignScript.Geometry.Point)
distanceTo = Geometry.DistanceTo(geometry=referencepoint, other=getItemAtIndex_3)
code_block_3 = CodeBlock { 2; }
round_2 = Math.Round(number=distanceTo, digits=code_block_3)
sort_2 = List.Sort(list=round_2)
indexOf_2 = List.IndexOf(list=round_2, element=sort_2)
getItemAtIndex_4 = List.GetItemAtIndex(list=getItemAtIndex_3@L2, index=indexOf_2@L2)
pointsSortedbyVector = Custom[PointsSortedbyVector](UnsortedPoints=getItemAtIndex_4@L2)  # Sort Points by Vector
byControlPoints = NurbsCurve.ByControlPoints(points=pointsSortedbyVector)
startPoint = Curve.StartPoint(curve=byControlPoints)
distanceTo_2 = Geometry.DistanceTo(geometry=startPoint, other=referencepoint)
endPoint = Curve.EndPoint(curve=byControlPoints)
distanceTo_3 = Geometry.DistanceTo(geometry=endPoint, other=referencepoint)
lt = distanceTo_2 < distanceTo_3
reverse = List.Reverse(list=pointsSortedbyVector@L2)
if_ = If(test=lt, true=pointsSortedbyVector, false=reverse)
byControlPoints_2 = NurbsCurve.ByControlPoints(points=if_)
splitsofthegrid = Input(splitsofthegrid: int)
code_block_4 = CodeBlock(Splits=splitsofthegrid) { 0..1..#Splits; }
pointAtParameter = Curve.PointAtParameter(curve=byControlPoints_2, param=code_block_4, lacing=CrossProduct)
byPoints = NurbsCurve.ByPoints(points=pointAtParameter)
numbertoremove = Input(numbertoremove: int)
removeNItemsBeginEnd = Custom[RemoveNItemsBeginEnd](list=byPoints, numbertoremove=numbertoremove)  # Removes a Number of Items from the Begining and from End
pointAtParameter_2 = Curve.PointAtParameter(curve=removeNItemsBeginEnd, param=code_block_4, lacing=CrossProduct)
transpose = List.Transpose(lists=pointAtParameter_2)
byPoints_2 = NurbsCurve.ByPoints(points=transpose)
crosslines = Output(byPoints_2)  # "crosslines:NurbsCurve[]"
normallines = Output(removeNItemsBeginEnd)  # "normallines:NurbsCurve[]"
