# Dynamo custom node TopologyLaticebyRadius.dyf (Dynamo 2.2.1.5175)
# category: PracticalBIM.Geometry.Abstract.Topology
# Creates a latice model of the topology selected

topology = Input(topology: Autodesk.DesignScript.Geometry.Topology)
edges = Topology.Edges(topology=topology)
curveGeometry = Edge.CurveGeometry(edge=edges)
code_block = CodeBlock { [0,1]; }
planeAtParameter = Curve.PlaneAtParameter(curve=curveGeometry, param=code_block, lacing=CrossProduct)
radius = Input(radius: double)
byPlaneRadius = Circle.ByPlaneRadius(plane=planeAtParameter, radius=radius)
byLoft = Solid.ByLoft(crossSections=byPlaneRadius)
vertices = Topology.Vertices(topology=topology)
pointGeometry = Vertex.PointGeometry(vertex=vertices)
byCenterPointRadius = Sphere.ByCenterPointRadius(centerPoint=pointGeometry, radius=radius)
join = List.Join(list0=byLoft, list1=byCenterPointRadius)
byUnion = Solid.ByUnion(solids=join)
Solid = Output(byUnion)
Points = Output(pointGeometry)  # "Points[]"
Line = Output(curveGeometry)  # "Line[]"
