# Dynamo custom node TransferPropertiesbyParameterName.dyf (Dynamo 2.3.0.5885)
# category: PracticalBIM.Revit.Elements.Element
# Transfer Properties by Parameter Name

newelement = Input(newelement: Revit.Elements.Element)
parametername = Input(parametername: string)
originalelement = Input(originalelement: Revit.Elements.Element)
getParameterValueByName = Element.GetParameterValueByName(element=originalelement, parameterName=parametername)
setParameterByName = Element.SetParameterByName(element=newelement, parameterName=parametername, value=getParameterValueByName, lacing=Longest)
Element = Output(setParameterByName)
