# Dynamo custom node TranslatebyPerpendicularPointandDistance.dyf (Dynamo 2.3.0.5885)
# category: PracticalBIM.Geometry.Modifiers
# Translates an Element by Perpendicular Point and Distance

geometry = Input(geometry: Autodesk.DesignScript.Geometry.Geometry)
perpendicularpoint = Input(perpendicularpoint: Autodesk.DesignScript.Geometry.Geometry)
closestPointTo = Geometry.ClosestPointTo(geometry=geometry, other=perpendicularpoint)
byTwoPoints = Vector.ByTwoPoints(start=closestPointTo, end=perpendicularpoint)
distance = Input(distance: double)
translate = Geometry.Translate(geometry=geometry, direction=byTwoPoints, distance=distance)
Geometry = Output(translate)
