# Dynamo custom node TriangleGridBySurface.dyf (Dynamo 2.2.1.5175)
# category: PracticalBIM.Geometry.Paneling
# Creates a Triangular Grid by a Surface

selectedsurface = Input(selectedsurface: Autodesk.DesignScript.Geometry.Surface)
U = Input(U: var[]..[])
listMatcher = Custom[ListMatcher](ListA=selectedsurface, ListB=U)  # Creates a matches between lists
V = Input(V: var[]..[])
listMatcher_2 = Custom[ListMatcher](ListA=selectedsurface, ListB=V)
python_script = Python(IN[0]=listMatcher.ListA, IN[1]=listMatcher.MatchListB, IN[2]=listMatcher_2.MatchListB)
# ---------- python_script.python (92 lines) ----------
#Copyright(c) 2014, Nathan Miller
# The Proving Ground, http://theprovingground.org

import clr
clr.AddReference('ProtoGeometry')
from Autodesk.DesignScript.Geometry import *

# Panel division class
class PanelDivision:
	
	# divide surface
	def TriDivision(self, srf, udiv, vdiv):
		ustep = 1.0/udiv
		vstep = 1.0/vdiv
		
		tris = []
		polys = []
		panels = []
		for i in range(0,int(udiv)):
			for j in range(0,int(vdiv)):
			
				triA = []
				triB = []
				
				#XYZ Tris A
				myXYZ1A = srf.PointAtParameter(i*ustep, j*vstep)
				myXYZ1B = srf.PointAtParameter((i+1)*ustep,j*vstep)
				myXYZ1C = srf.PointAtParameter((i+1)*ustep,(j+1)*vstep)
				
				#XYZ Tris B
				myXYZ2A = srf.PointAtParameter((i+1)*ustep,(j+1)*vstep)
				myXYZ2B = srf.PointAtParameter(i*ustep,(j+1)*vstep)
				myXYZ2C = srf.PointAtParameter(i*ustep, j*vstep)
				
				#Append to tri
				triA.append(myXYZ1A)
				triA.append(myXYZ1B)
				triA.append(myXYZ1C)
		
				triB.append(myXYZ2A)
				triB.append(myXYZ2B)
				triB.append(myXYZ2C)
				
				#Append tris
				tris.append(triA)
				tris.append(triB)
				
				#Polygons
				polyA = Polygon.ByPoints(triA)
				polyB = Polygon.ByPoints(triB)
				polys.append(polyA)
				polys.append(polyB)
				
				#Panels
				panelA = Surface.ByPerimeterPoints(triA)
				panelB = Surface.ByPerimeterPoints(triB)
				panels.append(panelA)
				panels.append(panelB)
				
		self.tris = tris
		self.polys = polys
		self.panels = panels

#Main code
srf = IN[0]
udiv = IN[1]
vdiv = IN[2]

tris = []
polys = []
panels = []

for k in range(0, len(srf)):
	s = srf[k]
	u = udiv[k]
	v = vdiv[k]
			
	divide = PanelDivision()
	divide.TriDivision(s,u,v)
					
	tris.append(divide.tris)
	panels.append(divide.panels)
	polys.append(divide.polys)
	

output = []
output.append(tris)
output.append(polys)
output.append(panels)

#Assign your output to the OUT variable
OUT = output
# ----------------------------------------
number = DoubleInput(0)
getItemAtIndex = List.GetItemAtIndex(list=python_script, index=number)
Panel_Pts = Output(getItemAtIndex)
number_2 = DoubleInput(1)
getItemAtIndex_2 = List.GetItemAtIndex(list=python_script, index=number_2)
Panel_Polys = Output(getItemAtIndex_2)
number_3 = DoubleInput(2)
getItemAtIndex_3 = List.GetItemAtIndex(list=python_script, index=number_3)
Panel_Faces = Output(getItemAtIndex_3)
