# Dynamo custom node VentilationConnectionBacktoTopPipeLine.dyf (Dynamo 2.2.1.5175)
# category: PracticalBIM.Revit.Elements.MEP.Ventilation
# Creates a Ventilation Pipes with a connected Top Pipeline

connectorpoints = Input(connectorpoints: Autodesk.DesignScript.Geometry.Point[])
ConnectedElements = Input(ConnectedElements: Revit.Elements.Element[])
getCategory = Element.GetCategory(element=ConnectedElements)
name = Category.Name(category=getCategory)
code_block = CodeBlock { "Piping Systems"; }
allIndicesOf = List.AllIndicesOf(list=name, item=code_block)
getItemAtIndex = List.GetItemAtIndex(list=connectorpoints, index=allIndicesOf)
Flatsurface = Input(Flatsurface: Autodesk.DesignScript.Geometry.Surface)
code_block_2 = CodeBlock { 0.5; }
pointAtParameter = Surface.PointAtParameter(surface=Flatsurface, u=code_block_2, v=code_block_2)
normalAtParameter = Surface.NormalAtParameter(surface=Flatsurface, u=code_block_2, v=code_block_2)
byOriginNormal = Plane.ByOriginNormal(origin=pointAtParameter, normal=normalAtParameter)
connectorvector = Input(connectorvector: Autodesk.DesignScript.Geometry.Vector[])
getItemAtIndex_2 = List.GetItemAtIndex(list=connectorvector, index=allIndicesOf)
project = Point.Project(point=getItemAtIndex, baseGeometry=byOriginNormal, projectionDirection=getItemAtIndex_2, lacing=Longest)
flatten = List.Flatten(list=project)
connectorradius = Input(connectorradius: double[])
getItemAtIndex_3 = List.GetItemAtIndex(list=connectorradius, index=allIndicesOf)
code_block_3 = CodeBlock(a=getItemAtIndex_3) { a*0.3048*2; }
translate = Geometry.Translate(geometry=flatten, direction=getItemAtIndex_2, distance=code_block_3)
line1 = Line.ByStartPointEndPoint(startPoint=getItemAtIndex, endPoint=translate)
flatten_2 = List.Flatten(list=line1)
Line1 = Output(flatten_2)  # "Line1:Line[]"
X = Point.X(point=translate)
Y = Point.Y(point=translate)
pipeline = Input(pipeline: Revit.Elements.Element)
getLocation = Element.GetLocation(element=pipeline)
startPoint = Curve.StartPoint(curve=getLocation)
Z = Point.Z(point=startPoint)
byCoordinates = Point.ByCoordinates(x=X, y=Y, z=Z)
line_2 = Line.ByStartPointEndPoint(startPoint=translate, endPoint=byCoordinates)
flatten_3 = List.Flatten(list=line_2)
Line2 = Output(flatten_3)  # "Line2:Line[]"
closestPointTo = Geometry.ClosestPointTo(geometry=getLocation, other=byCoordinates)
line3 = Line.ByStartPointEndPoint(startPoint=byCoordinates, endPoint=closestPointTo)
flatten_4 = List.Flatten(list=line3)
Line3 = Output(flatten_4)  # "Line3:Line[]"
