# Dynamo custom node VerticalCoordinateSystembyPointandVector.dyf (Dynamo 2.3.0.5885)
# category: PracticalBIM.Geometry.Abstract.CoordinateSystems
# Creates a vertical Coordinate System by a Point and a Vector

origin = Input(origin: Autodesk.DesignScript.Geometry.Point)
vector = Input(vector: Autodesk.DesignScript.Geometry.Vector)
ZAxis = Vector.ZAxis()
code_block = CodeBlock { 90; }
rotate = Vector.Rotate(vector=vector, axis=ZAxis, degrees=code_block)
byOriginVectors = CoordinateSystem.ByOriginVectors(origin=origin, xAxis=vector, yAxis=rotate, zAxis=ZAxis)
CoordinateSystem = Output(byOriginVectors)
