# Dynamo custom node VerticalPlaneByLine.dyf (Dynamo 2.2.1.5175)
# category: PracticalBIM.Geometry.Abstract.Plane
# Creates a vertical Plane by a given Line

curve = Input(curve: Autodesk.DesignScript.Geometry.Curve)
code_block = CodeBlock { 0.5; }
pointAtParameter = Curve.PointAtParameter(curve=curve, param=code_block)
code_block_2 = CodeBlock { 5; }
byCoordinates = Vector.ByCoordinates(z=code_block_2)
translate = Geometry.Translate(geometry=pointAtParameter, direction=byCoordinates)
byLineAndPoint = Plane.ByLineAndPoint(line=curve, point=translate)
Plane = Output(byLineAndPoint)
