# Dynamo custom node VerticalPlaneFromLine.dyf (Dynamo 2.2.1.5175)
# category: PracticalBIM.Geometry.Abstract.Plane
# Creates a vertical Plane From a Line

curves = Input(curves: Autodesk.DesignScript.Geometry.Curve[])
code_block = CodeBlock { 0.5; }
pointAtParameter = Curve.PointAtParameter(curve=curves, param=code_block, lacing=Longest)
code_block_2 = CodeBlock { 5; }
byCoordinates = Vector.ByCoordinates(z=code_block_2)
translate = Geometry.Translate(geometry=pointAtParameter, direction=byCoordinates, lacing=Longest)
byLineAndPoint = Plane.ByLineAndPoint(line=curves, point=translate)
Plane = Output(byLineAndPoint)  # "Plane[]"
