# Dynamo custom node VerticalSeparationofSchedules.dyf (Dynamo 2.2.1.5175)
# category: PracticalBIM.GN
# Sets a Vertical Separation of Schedules

code_block = CodeBlock { 0; }
list = Input(list: var[]..[])
uniqueItems = List.UniqueItems(list=list@L2)
count = List.Count(list=uniqueItems@L2)
removeLast = Custom[RemoveLast](list=count)  # Remove Last element of a List
valueofseparation = Input(valueofseparation: double)
code_block_2 = CodeBlock(a=removeLast, b=valueofseparation) { -a*b; }
addItemToFront = List.AddItemToFront(item=code_block, list=code_block_2)
count_2 = List.Count(list=addItemToFront)
code_block_3 = CodeBlock(a=count_2) { 1..#a..1; }
code_block_4 = CodeBlock(a=code_block_3) { 0..#a..1; }
getItemAtIndex = List.GetItemAtIndex(list=addItemToFront, index=code_block_4)
sum = Math.Sum(values=getItemAtIndex)
distances = Output(sum)  # "distances:double[]"
