# Dynamo custom node VerticalSlicingLinesFromVoids.dyf (Dynamo 2.2.1.5175)
# category: PracticalBIM.Geometry.Paneling
# Creates Vertical Slicing Lines from Voids to Create squared Formwork

curve = Input(curve: Autodesk.DesignScript.Geometry.Curve[])
startPoint = Curve.StartPoint(curve=curve)
X = Point.X(point=startPoint)
code_block = CodeBlock { 2; }
round = Math.Round(number=X, digits=code_block)
Y = Point.Y(point=startPoint)
code_block_2 = CodeBlock { 2; }
round_2 = Math.Round(number=Y, digits=code_block_2)
code_block_3 = CodeBlock(a=round, b=round_2) { a+"_"+b; }
uniqueItems = List.UniqueItems(list=code_block_3@L2)
firstIndexOf = List.FirstIndexOf(list=code_block_3, item=uniqueItems)
getItemAtIndex = List.GetItemAtIndex(list=X@L2, index=firstIndexOf@L2)
getItemAtIndex_2 = List.GetItemAtIndex(list=Y@L2, index=firstIndexOf@L2)
Z = Point.Z(point=startPoint)
minimumItem = List.MinimumItem(list=Z)
byCoordinates = Point.ByCoordinates(x=getItemAtIndex, y=getItemAtIndex_2, z=minimumItem)
maximumItem = List.MaximumItem(list=Z)
byCoordinates_2 = Point.ByCoordinates(x=getItemAtIndex, y=getItemAtIndex_2, z=maximumItem)
byStartPointEndPoint = Line.ByStartPointEndPoint(startPoint=byCoordinates, endPoint=byCoordinates_2)
flatten = List.Flatten(list=byStartPointEndPoint)
startPoint_2 = Curve.StartPoint(curve=byStartPointEndPoint)
flatten_2 = List.Flatten(list=startPoint_2)
string_from_object = FromObject(obj=flatten_2)
pointsSortedbyVector = Custom[PointsSortedbyVector](UnsortedPoints=flatten_2)  # Sort Points by Vector
string_from_object_2 = FromObject(obj=pointsSortedbyVector)
indexOf = List.IndexOf(list=string_from_object, element=string_from_object_2)
getItemAtIndex_3 = List.GetItemAtIndex(list=flatten, index=indexOf)
Line = Output(getItemAtIndex_3)  # "Line[]"
