# Dynamo custom node WallByNewGeometry.dyf (Dynamo 2.2.1.5175)
# category: PracticalBIM.Revit.Elements.Wall
# Creates Walls By New Geometry and Heigth

curve = Input(curve: Autodesk.DesignScript.Geometry.Curve[])
height = Input(height: double[])
originalelement = Input(originalelement: Revit.Elements.Element)
code_block = CodeBlock { "Base Constraint"; }
getParameterValueByName = Element.GetParameterValueByName(element=originalelement, parameterName=code_block)
code_block_2 = CodeBlock { "Type"; }
getParameterValueByName_2 = Element.GetParameterValueByName(element=originalelement, parameterName=code_block_2)
byCurveAndHeight = Wall.ByCurveAndHeight(curve=curve, height=height, level=getParameterValueByName, wallType=getParameterValueByName_2, lacing=Longest)
Wall = Output(byCurveAndHeight)  # "Wall[]"
