# Dynamo custom node WallGetProfilewithVoids.dyf (Dynamo 2.2.1.5175)
# category: PracticalBIM.Revit.Elements.Wall
# Gets the wall profile from a revit element

element = Input(element: Revit.Elements.Element[])
geometry = Element.Geometry(element=element)
getLocation = Element.GetLocation(element=element)
ZAxis = Vector.ZAxis()
code_block = CodeBlock { "Unconnected Height"; }
getParameterValueByName = Element.GetParameterValueByName(element=element, parameterName=code_block)
extrude = Curve.Extrude(curve=getLocation, direction=ZAxis, distance=getParameterValueByName)
intersect = Geometry.Intersect(geometry=geometry, other=extrude)
flatten = List.Flatten(list=intersect)
ProfileSurface = Output(flatten)  # "ProfileSurface:Surface[]"
