# Dynamo custom node Quads from Rectangular Grid.dyf (Dynamo 2.11.1.4675)
# category: buildz
# Given a grid of points (xyz or uv) in lists of rows/columns, create a list of quadrilaterals

points = Input(points: Autodesk.DesignScript.Geometry.Point[][])
code_block = CodeBlock { -1; }
shiftIndices = List.ShiftIndices(list=points@L2, amount=code_block)
code_block_2 = CodeBlock { -1; }
shiftIndices_2 = List.ShiftIndices(list=points, amount=code_block_2)
code_block_3 = CodeBlock { -1; }
shiftIndices_3 = List.ShiftIndices(list=shiftIndices_2@L2, amount=code_block_3)
create = List.Create(item0=points, item1=shiftIndices, item2=shiftIndices_3, item3=shiftIndices_2)
transpose = List.Transpose(lists=create)
transpose_2 = List.Transpose(lists=transpose@L3)
reverse = List.Reverse(list=transpose_2)
restOfItems = List.RestOfItems(list=reverse)
reverse_2 = List.Reverse(list=restOfItems@L3)
restOfItems_2 = List.RestOfItems(list=reverse_2@L3)
Quad_Points = Output(restOfItems_2)
