# Dynamo graph built-in-category.dyn (Dynamo 2.5.0.7460)
# packages: QuasarII 1.0.0

categories = Categories("OST_CurtaSystem")
categories_2 = Categories("OST_StairsRailing")
list_create = List.Create(item0=categories, item1=categories_2)
# note: Collect BuiltInCategory object(s).
# BuiltIns.GetBuiltInCategory (categories: Cat ...
getBuiltInCategory = QuasarII.BuiltIns.GetBuiltInCategory(categories=list_create)
