# Dynamo graph elevations-by-rooms.dyn (Dynamo 2.5.0.7460)
# packages: QuasarII 1.0.0

categories = Categories("OST_Rooms")
all_elements_of_category = ElementsOfCategory(Category=categories)
elevation_viewfamilytype = ElevationVFTypeUIDropDown("Interior Elevation")
code_block = CodeBlock { 50; 500; }
createElevationsByRooms = QuasarII.ViewUtility.CreateElevationsByRooms(Rooms=all_elements_of_category, viewFamilyType=elevation_viewfamilytype, Scale=code_block.out0, Offset=code_block.out1)
