# Dynamo graph center-space-tags.dyn (Dynamo 2.5.0.7460)
# packages: QuasarII 1.0.0

views = Views("Level 1")
categories = Categories("OST_MEPSpaceTags")
all_elements_of_category = ElementsOfCategory(Category=categories)
# note: Relocate spaces' tags to the spaces' location points in given View.
# MEPSpaces.S ...
spaceTagToSpace = QuasarII.MEPSpaces.SpaceTagToSpace(view=views, SpaceTags=all_elements_of_category)
