# Dynamo graph center-spaces.dyn "get-spaces" (Dynamo 2.5.0.7460)
# packages: QuasarII 1.0.0

# note: Collect a Zone from the Document.
zones = ZoneUIDropDown("LHS Zone")
# note: Collect Space(s) from a Zone.
# MEPSpaces.GetSpacesByZone (zone: var): Element[]
getSpacesByZone = QuasarII.MEPSpaces.GetSpacesByZone(zone=zones)
# note: Relocate Spaces' location points to the center of the Spaces.
# MEPSpaces.CenterS ...
centerSpace = QuasarII.MEPSpaces.CenterSpace(Spaces=getSpacesByZone)
