# Dynamo graph copy-filters.dyn (Dynamo 2.5.0.7460)
# packages: QuasarII 1.0.0

views = Views("Level 1")
views_2 = Views("Level 2")
views_3 = Views("101_MEETING")
views_4 = Views("102_CONFERENCE")
list_create = List.Create(item0=views_2, item1=views_3, item2=views_4)
copyFiltersFromView = QuasarII.ElementGraphics.CopyFiltersFromView(FromView=views, ToViews=list_create)
