# Dynamo graph space-name-numbering.dyn "add-spaces-to-zone" (Dynamo 2.5.0.7460)
# packages: QuasarII 1.0.0

zones = ZoneUIDropDown("LHS Zone")
getSpacesByZone = QuasarII.MEPSpaces.GetSpacesByZone(zone=zones)
spaceNameNumbering = QuasarII.MEPSpaces.SpaceNameNumbering(Spaces=getSpacesByZone)
