# Dynamo custom node RIE_AllLoadedFamilies.dyf (Dynamo 2.6.1.8786)
# category: RIE.Elements
# Retrieves a Family list containing all families loaded in input project document. (If no input  a list of families will be retrieved from current document)

refresh = Input(refresh: bool = false)
LinkOptional = Input(LinkOptional: var = null)
python_script = Python(IN[0]=refresh, IN[1]=LinkOptional)
# ---------- python_script.python (59 lines) ----------
# @ Copyright - Designed by André Abotnes andre.abotnes@norconsult.com
import sys
#pyt_path = r"C:\Program Files (x86)\IronPython 2.7\DLLs"
#sys.path.append(pyt_path)
import clr

#clr.AddReference('IronPython.SQLite.dll')
pyt_path = r"C:\Program Files (x86)\IronPython 2.7\Lib"
sys.path.append(pyt_path)
#import sqlite3

# Import ToDSType(bool) extension method
clr.AddReference('RevitNodes')
import Revit
clr.ImportExtensions(Revit.GeometryConversion)
clr.ImportExtensions(Revit.Elements)

# Import DesignScript.Geometry
clr.AddReference('ProtoGeometry')
from Autodesk.DesignScript.Geometry import *

# Import DocumentManager and TransactionManager
clr.AddReference('RevitServices')
import RevitServices
from RevitServices.Persistence import DocumentManager
from RevitServices.Transactions import TransactionManager

doc = DocumentManager.Instance.CurrentDBDocument
uidoc = DocumentManager.Instance.CurrentUIApplication.ActiveUIDocument
app = DocumentManager.Instance.CurrentUIApplication.Application

# Import List ( ICollection(ElementId) = List[ElementId]() )
clr.AddReference('System')
from System.Collections.Generic import List

# Import Revit API + APIUI
clr.AddReference('RevitAPI')
from Autodesk.Revit.DB import *
from Autodesk.Revit.DB.Electrical import *

clr.AddReference('RevitAPIUI')
from Autodesk.Revit.UI import *

OUT = []

if IN[1] != None:
	doc = UnwrapElement(IN[1]).GetLinkDocument()

ftypes = FilteredElementCollector(doc).WhereElementIsElementType().ToElements()

fnames = []

for t in ftypes:
	try:
		if t.Family.Name not in fnames:
			fnames.append(t.Family.Name)
			OUT.append(t.Family)
	except:
		continue
# ----------------------------------------
families = Output(python_script)
