# Dynamo custom node RIE_BCFZipReader.dyf (Dynamo 1.3.2.2480)
# category: RIE.BCF
# Reads contents of BCFzip. Adjusted for use in Norconsult. Input directorypath of unzipped BCFzip folder.

path = Input()
fromPath = DirectoryObject(path)  # "Directory.FromPath"
contents = Directory.Contents(fromPath)
sort = List.Sort(contents.out1)
fromPath_2 = DirectoryObject(sort)  # "Directory.FromPath"
contents_2 = Directory.Contents(fromPath_2)
flatten = Flatten(contents_2)
string = StringInput(".bcf")
contains = String.Contains(str=flatten, searchFor=string)
filterByBoolMask = List.FilterByBoolMask(list=flatten, mask=contains)
code_block = CodeBlock { ".bcfv"; }
code_block_2 = CodeBlock { true; }
contains_2 = String.Contains(str=filterByBoolMask.in, searchFor=code_block, ignoreCase=code_block_2)
sortByKey = List.SortByKey(list=filterByBoolMask.in, keys=contains_2)
directoryName = FilePath.DirectoryName(sortByKey.sorted_list)
sortByKey_2 = List.SortByKey(list=sortByKey.sorted_list, keys=directoryName)
groupByKey = List.GroupByKey(list=sortByKey_2.sorted_list, keys=sortByKey_2.sorted_keys)
count = Count(groupByKey.groups@L2)
python_script = Python(IN[0]=sortByKey_2.sorted_list)
# ---------- python_script.python (28 lines) ----------
import clr
import sys
clr.AddReference('ProtoGeometry')
from Autodesk.DesignScript.Geometry import *
sys.path.append("C:\Program Files (x86)\IronPython 2.7\Lib")
#from xml.parsers.expat import expat -- can't find this
import xml.etree.ElementTree as ET
#The inputs to this node will be stored as a list in the IN variables.

def tolist(input):
	if isinstance(input,list):
		return input
	else:
		return [input]

fp = tolist(IN[0])

OUT = []

for filePath in fp:
	uniStr = unicode(open(filePath, 'r').read())
	#fixed = uniStr.encode('utf-8', 'replace')
	fixed = uniStr.encode('ascii', 'replace')
	fixed.decode('utf-8', 'replace')
	tree = ET.ElementTree(ET.fromstring(fixed))
	#start tree code
	#Assign your output to the OUT variable.
	OUT.append(tree)
# ----------------------------------------
string_2 = StringInput("./Topic/Index")
python_script_2 = Python(IN[0]=python_script, IN[1]=string_2)
# ---------- python_script_2.python (69 lines) ----------
import clr
import sys
clr.AddReference('ProtoGeometry')
from Autodesk.DesignScript.Geometry import *
sys.path.append("C:\Program Files (x86)\IronPython 2.7\Lib")
#from xml.parsers.expat import expat -- can't find this
import xml.etree.ElementTree as ET
#The inputs to this node will be stored as a list in the IN variables.

def tolist(input):
	if isinstance(input, list):
		return input
	else:
		return [input]
		
xmTr = tolist(IN[0])
xpths = tolist(IN[1])

OUT = []

for xmTree in xmTr:
	values = []
	#xmParsed = xmTree.parse(xmlFile)
	#root = xmTree.getroot()
	try:
		root = xmTree.getroot()
	except:
		root = xmTree
	for xpathstr in xpths:
		xtags, xtext, xcountattrib, xattrib, xattvals, xcountiter, xitertags, xitervals, xparents = [], [], [], [], [], [], [], [], []
		xpathfound = root.findall(xpathstr)
		#xparentstr = xpathstr + "/.."
		#xparentfound = root.findall(xpathstr+"/..")
		for x in xpathfound:
			xtags.append(x.tag)
			if x.text:
				try:
					xtext.append(str(int(x.text)+1))
				except:
					xtext.append("_none_")
			else:
				xtext.append("_none_")
			if x.keys():
				xcountattrib.append(len(x.items()))
				for name, value in x.items():
					xattrib.append(name)
					xattvals.append(value)
		#PARENT CODE BELOW IS TOO SLOW
		#			try:
		#				xparents.append(root.find(xpathstr + "/" + name + "/.."))
		#			except:
		#				xparents.append("no parent found")
			else:
				xcountattrib.append(1)
				xattrib.append("_none_")
				xattvals.append("_none_")
		
		#THIS METHOD NOT GREAT
		#	if x.iter():
		#		xcountiter.append(len(x.iter()))
		#		for name, value in x.iter():
		#			xitertags.append(name)
		#			xitervals.append(value)
		#for y in xparentfound:
		#	xparents.append(y.tag)
		
		OUT.append(xtext)
		#, xparents
		#, xparentfound#, xparents#, xcountiter, xitertags, xitervals
# ----------------------------------------
string_3 = StringInput("./Topic/Title")
python_script_3 = Python(IN[0]=python_script, IN[1]=string_3)
# ---------- python_script_3.python (69 lines) ----------
import clr
import sys
clr.AddReference('ProtoGeometry')
from Autodesk.DesignScript.Geometry import *
sys.path.append("C:\Program Files (x86)\IronPython 2.7\Lib")
#from xml.parsers.expat import expat -- can't find this
import xml.etree.ElementTree as ET
#The inputs to this node will be stored as a list in the IN variables.

def tolist(input):
	if isinstance(input, list):
		return input
	else:
		return [input]
		
xmTr = tolist(IN[0])
xpths = tolist(IN[1])

OUT = []

for xmTree in xmTr:
	values = []
	#xmParsed = xmTree.parse(xmlFile)
	#root = xmTree.getroot()
	try:
		root = xmTree.getroot()
	except:
		root = xmTree
	for xpathstr in xpths:
		xtags, xtext, xcountattrib, xattrib, xattvals, xcountiter, xitertags, xitervals, xparents = [], [], [], [], [], [], [], [], []
		xpathfound = root.findall(xpathstr)
		#xparentstr = xpathstr + "/.."
		#xparentfound = root.findall(xpathstr+"/..")
		for x in xpathfound:
			xtags.append(x.tag)
			if x.text:
				try:
					xtext.append(x.text)
				except:
					xtext.append("_none_")
			else:
				xtext.append("_none_")
			if x.keys():
				xcountattrib.append(len(x.items()))
				for name, value in x.items():
					xattrib.append(name)
					xattvals.append(value)
		#PARENT CODE BELOW IS TOO SLOW
		#			try:
		#				xparents.append(root.find(xpathstr + "/" + name + "/.."))
		#			except:
		#				xparents.append("no parent found")
			else:
				xcountattrib.append(1)
				xattrib.append("_none_")
				xattvals.append("_none_")
		
		#THIS METHOD NOT GREAT
		#	if x.iter():
		#		xcountiter.append(len(x.iter()))
		#		for name, value in x.iter():
		#			xitertags.append(name)
		#			xitervals.append(value)
		#for y in xparentfound:
		#	xparents.append(y.tag)
		
		OUT.append(xtext)
		#, xparents
		#, xparentfound#, xparents#, xcountiter, xitertags, xitervals
# ----------------------------------------
string_4 = StringInput("./Topic/Description")
python_script_4 = Python(IN[0]=python_script, IN[1]=string_4)  # same code as python_script_3
string_5 = StringInput("./Components/Component/AuthoringToolId")
python_script_5 = Python(IN[0]=python_script, IN[1]=string_5)  # same code as python_script_3
python_script_6 = Python(IN[0]=count, IN[1]=python_script_2, IN[2]=python_script_3, IN[3]=python_script_4, IN[4]=python_script_5)
# ---------- python_script_6.python (33 lines) ----------
liste = []
OUT = []

j = 0
x = 0

ids = []
output = []

for i in range(0, len(IN[1])):
	fp = IN[0][j]
	
	if x == 0:
		liste.append(IN[1][i])
		liste.append(IN[2][i])
		liste.append(IN[3][i])
	else:
		liste.append(IN[4][i])
	x += 1
	if fp == x:
		for i in range(3, len(liste)):
			for _ in liste[i]:
				ids.append(_)
		output.append(liste[0])
		output.append(liste[1])
		output.append(liste[2])
		output.append(ids)
		liste = []
		ids = []
		OUT.append(output)
		output = []
		j += 1
		x = 0
# ----------------------------------------
code_block_3 = CodeBlock { 0; }
getItemAtIndex = List.GetItemAtIndex(index=code_block_3)  # unwired: list
map = List.Map(list=python_script_6, f_x=getItemAtIndex)
flatten_2 = Flatten(map)
toNumber = String.ToNumber(flatten_2)
sortByKey_3 = List.SortByKey(list=python_script_6, keys=toNumber)
code_block_4 = CodeBlock { 0; }
getItemAtIndex_2 = List.GetItemAtIndex(index=code_block_4)  # unwired: list
map_2 = List.Map(list=sortByKey_3.sorted_list, f_x=getItemAtIndex_2)
Index = Output(map_2)
code_block_5 = CodeBlock { 1; }
getItemAtIndex_3 = List.GetItemAtIndex(index=code_block_5)  # unwired: list
map_3 = List.Map(list=sortByKey_3.sorted_list, f_x=getItemAtIndex_3)
Title = Output(map_3)
code_block_6 = CodeBlock { 2; }
getItemAtIndex_4 = List.GetItemAtIndex(index=code_block_6)  # unwired: list
map_4 = List.Map(list=sortByKey_3.sorted_list, f_x=getItemAtIndex_4)
Description = Output(map_4)
code_block_7 = CodeBlock { 3; }
getItemAtIndex_5 = List.GetItemAtIndex(index=code_block_7)  # unwired: list
map_5 = List.Map(list=sortByKey_3.sorted_list, f_x=getItemAtIndex_5)
Ids = Output(map_5)
