# Dynamo custom node RIE_ChamferedWire.dyf (Dynamo 1.3.2.2480)
# category: RIE.Power
# Input from and to element, with connection points and vertices in order. Input wire type as well.

Elements = Input()
Vertices = Input()
WireType = Input()
python_script = Python(IN[0]=Elements, IN[1]=Vertices, IN[2]=WireType)
# ---------- python_script.python (59 lines) ----------
import clr
clr.AddReference('ProtoGeometry')
from Autodesk.DesignScript.Geometry import *

clr.AddReference('RevitServices')
import RevitServices
from RevitServices.Persistence import DocumentManager
from RevitServices.Transactions import TransactionManager
from System.Collections.Generic import *

clr.AddReference('RevitNodes')
import Revit
clr.ImportExtensions(Revit.Elements)
clr.ImportExtensions(Revit.GeometryConversion)

clr.AddReference('RevitAPI')
import Autodesk
from Autodesk.Revit.DB import *
from Autodesk.Revit.DB.Electrical import *

clr.AddReference('DSCoreNodes')
import DSCore
from DSCore.List import *

import sys
pyt_path = r'C:\Program Files (x86)\IronPython 2.7\Lib'
sys.path.append(pyt_path)

from System.Collections.Generic import List

conns = []

points = [x.ToXyz() for x in IN[1]]
vertexpoints = List[XYZ](points)

for fitting in UnwrapElement(IN[0]):
	try:
		connectors = fitting.MEPModel.ConnectorManager.Connectors
	except:
		connectors = fitting.ConnectorManager.Connectors
	for conn in connectors:
		conns.append(conn)
wiretyp = UnwrapElement(IN[2])
uiapp = DocumentManager.Instance.CurrentUIApplication
uidoc = uiapp.ActiveUIDocument
curview = uidoc.ActiveView

doc = DocumentManager.Instance.CurrentDBDocument
wireTypeId = wiretyp[0].Id
view = curview.Id
wiringType = WiringType.Chamfer
sConnector = conns[0]
eConnector = conns[1]

TransactionManager.Instance.EnsureInTransaction(doc)
creation = Wire.Create(doc,wireTypeId,view,wiringType,vertexpoints,sConnector,eConnector)
TransactionManager.Instance.TransactionTaskDone()

OUT = creation
# ----------------------------------------
Wire = Output(python_script)
