# Dynamo custom node RIE_CreatePanelSchedule.dyf (Dynamo 2.3.0.5885)
# category: RIE.Views
# Creates PanelSchedule from input Panel elements. Uses default Template if no template is input.

panel = Input(panel: var[]..[])
template = Input(template: int = 0)
python_script = Python(IN[0]=panel, IN[1]=template)
# ---------- python_script.python (44 lines) ----------
import clr
clr.AddReference('RevitAPI')
from Autodesk.Revit.DB import *
from Autodesk.Revit.DB.Electrical import *
clr.AddReference('RevitServices')
import RevitServices
from RevitServices.Persistence import DocumentManager
from RevitServices.Transactions import TransactionManager

# Import ToDSType(bool) extension method
clr.AddReference("RevitNodes")
import Revit
clr.ImportExtensions(Revit.Elements)

doc = DocumentManager.Instance.CurrentDBDocument
uiapp = DocumentManager.Instance.CurrentUIApplication
app = uiapp.Application
#The inputs to this node will be stored as a list in the IN variables.

OUT = []

def tolist(obj):
	if isinstance(obj, list):
		return UnwrapElement(obj)
	else:
		return UnwrapElement([obj])

panels = tolist(IN[0])
templates = tolist(IN[1])

TransactionManager.Instance.EnsureInTransaction(doc)

if len(templates) > 1:
	for panel, temp in zip(panels,templates):
		OUT.append(PanelScheduleView.CreateInstanceView(doc, panel.Id, temp))
else:
	try:
		for panel in panels:
			OUT.append(PanelScheduleView.CreateInstanceView(doc, panel.Id, templates[0]))
	except:
		for panel in panels:
			OUT.append(PanelScheduleView.CreateInstanceView(doc, panel.Id))
			
TransactionManager.Instance.TransactionTaskDone()
# ----------------------------------------
panelScheduleViews = Output(python_script)
