# Dynamo custom node RIE_DropNthItemInSublists.dyf (Dynamo 2.3.0.5885)
# category: RIE.List
# Input list of indexes to be dropped from each sublist.

lists = Input(lists: var[]..[])
indices = Input(indices: var[]..[])
python_script = Python(IN[0]=lists, IN[1]=indices)
# ---------- python_script.python (17 lines) ----------
import clr
clr.AddReference('ProtoGeometry')
from Autodesk.DesignScript.Geometry import *

List = IN[0]
Nth = IN[1]
OUT = []
collector = []
nth = 0

for i in List:
	for _ in i:
		if i.index(_) <> Nth[nth]:
			collector.append(_)
	OUT.append(collector)
	collector = []
	nth += 1
# ----------------------------------------
Lists = Output(python_script)
