# Dynamo custom node RIE_ElementsInBBox.dyf (Dynamo 2.3.0.5885)
# category: RIE.Elements
# Returns elements contained by input BoundingBox.
# packages: RIE 2020.11.18

BBox = Input(BBox: var[]..[])
OnlyInside = Input(OnlyInside: bool = false)
LinkOptional = Input(LinkOptional: var = null)
linkDocFromLink = Custom[RIE.LinkDocFromLink](LinkInstance=LinkOptional)  # package RIE; Retrieves link Document element from link element.
python_script = Python(IN[0]=BBox, IN[1]=OnlyInside, IN[2]=linkDocFromLink)
# ---------- python_script.python (44 lines) ----------
# RETRIEVED FROM EINAR RAKNES ON THE DYNAMOBIM.ORG FORUMS.

import clr
clr.AddReference('RevitAPI')
clr.AddReference('RevitNodes')
clr.AddReference('RevitServices')
import Revit
import RevitServices
from Autodesk.Revit.DB import *
from RevitServices.Persistence import DocumentManager
clr.ImportExtensions(Revit.Elements)
clr.ImportExtensions(Revit.GeometryConversion)

doc = DocumentManager.Instance.CurrentDBDocument

if IN[2] != None:
	doc = UnwrapElement(IN[2])

def tolist(obj):
	if isinstance(obj,list):
		return UnwrapElement(obj)
	else:
		return [UnwrapElement(obj)]

#Preparing input from dynamo to revit
bbs = tolist(IN[0])
OUT = []

for bbx in bbs:
	elems = []
	bb = bbx.ToRevitType()
	outline = Outline(bb.Min, bb.Max)
	#filter = BoundingBoxIntersectsFilter(outline)
	if IN[1] == False:
		filter = BoundingBoxIntersectsFilter(outline)
	else:
		filter = BoundingBoxIsInsideFilter(outline)
	
	collector = FilteredElementCollector(doc).WherePasses(filter).WhereElementIsNotElementType().WhereElementIsViewIndependent()
	
	elems = [e.ToDSType(True) for e in collector]
	OUT.append(elems)
if len(OUT) == 1:
	OUT = OUT[0]
# ----------------------------------------
Elements = Output(python_script)
