# Dynamo custom node RIE_ElementsOfCategoryByView.dyf (Dynamo 2.3.0.5885)
# category: RIE.Elements
# Retrieves all elements of an input category in input views.
# packages: RIE 0.7.1

views = Input(views: var[]..[])
category = Input(category: var[]..[])
buildinCategoryFromCategory = Custom[RIE.BuildinCategoryFromCategory](Cat=category@L1)  # package RIE; Returns the OST builtincategory from input category.
elements_of_category_in_views = Python(IN[0]=views, IN[1]=buildinCategoryFromCategory)
# ---------- elements_of_category_in_views.python (33 lines) ----------
#Made by Marc Tavenier @marctavenier
import clr, System
clr.AddReference("RevitNodes")
import Revit
clr.AddReference('RevitAPI')
from Autodesk.Revit.DB import *

clr.AddReference('RevitServices')
import RevitServices
from RevitServices.Persistence import DocumentManager

doc = DocumentManager.Instance.CurrentDBDocument

def tolist(obj):
	if isinstance(obj, list):
		return UnwrapElement(obj)
	else:
		return [UnwrapElement(obj)]

cats = tolist(IN[1])
views = tolist(IN[0])
elems = []
OUT = []

for view in views:
	elems = []
	for cat in cats:
		filter = FilteredElementCollector(doc, view.Id).OfCategory(cat)
		elems.append(filter.ToElements())
	OUT.append(elems)

if len(OUT) == 1:
	OUT = OUT[0]
# ----------------------------------------
Elements = Output(elements_of_category_in_views)
