# Dynamo custom node RIE_GetCategoriesFromString.dyf (Dynamo 2.3.0.5885)
# category: RIE.Elements
# Returns Categories by Name
# packages: RIE 0.7.1

python_script = Python()
# ---------- python_script.python (21 lines) ----------
import clr
clr.AddReference('RevitAPI')
from Autodesk.Revit.DB import *

clr.AddReference("RevitNodes")
import Revit
clr.ImportExtensions(Revit.Elements)
clr.ImportExtensions(Revit.GeometryConversion)

clr.AddReference("RevitServices")
import RevitServices
from RevitServices.Persistence import DocumentManager
from RevitServices.Transactions import TransactionManager

doc = DocumentManager.Instance.CurrentDBDocument
categories = doc.Settings.Categories

OUT = []

for c in categories:
	OUT.append(Revit.Elements.Category.ById(c.Id.IntegerValue))
# ----------------------------------------
string_from_object = FromObject(obj=python_script)
str = Input(str: var[]..[])
eq = string_from_object == str@L1
code_block = CodeBlock { true; }
RIE_IndexOf = Custom[RIE_IndexOf](list=eq@L2, Item=code_block)  # package RIE; Returns a sublistlist with all indexes for each item.
flatten = List.Flatten(list=RIE_IndexOf)
getItemAtIndex = List.GetItemAtIndex(list=python_script, index=flatten)
code_block_2 = CodeBlock { null; }
isEmpty = List.IsEmpty(list=RIE_IndexOf@L2)
RIE_IndexOf_2 = Custom[RIE_IndexOf](list=isEmpty, Item=code_block)
flatten_2 = List.Flatten(list=RIE_IndexOf_2)
count = List.Count(list=flatten_2)
ofRepeatedItem = List.OfRepeatedItem(item=code_block_2, amount=count)
RIE_InsertItemAtIndex = Custom[RIE_InsertItemAtIndex](list=getItemAtIndex, Item=ofRepeatedItem, Index=flatten_2)  # package RIE; Inserts Items into list at given index; unwired: method
Category = Output(RIE_InsertItemAtIndex)
