# Dynamo custom node RIE_Increment_Rotation.dyf (Dynamo 2.3.0.5885)
# category: RIE.Elements
# Rotates input elements by input angle in degrees (CCW if positive). Angle can be single input or list input at equal size of elements' input list.
# Tags : Rotate Groups, Rotate Model Groups, Rotate Element, Rotate Family Instance.

elements = Input(elements: var[]..[])
degrees = Input(degrees: var[]..[])
python_script = Python(IN[0]=elements, IN[1]=degrees)
# ---------- python_script.python (73 lines) ----------
import clr
import math
from operator import itemgetter

clr.AddReference('ProtoGeometry')
from Autodesk.DesignScript.Geometry import *

# Import RevitAPI
clr.AddReference("RevitAPI")
import Autodesk
from Autodesk.Revit.DB import ReferencePointArray
from Autodesk.Revit.DB import ElementTransformUtils

# Import DocumentManager and TransactionManager
clr.AddReference("RevitServices")
import RevitServices
from RevitServices.Persistence import DocumentManager
from RevitServices.Transactions import TransactionManager

# Import ToDSType(bool) extension method
clr.AddReference("RevitNodes")
import Revit
clr.ImportExtensions(Revit.Elements)
clr.ImportExtensions(Revit.GeometryConversion)

doc = DocumentManager.Instance.CurrentDBDocument
uidoc = DocumentManager.Instance.CurrentUIApplication.ActiveUIDocument
app = DocumentManager.Instance.CurrentUIApplication.Application

# Import List ( ICollection(ElementId) = List[ElementId]() )

fttomm = 304.8
OUT = []

def tolist(obj):
	if not isinstance(obj, list):
		return [UnwrapElement(obj)]
	else:
		return UnwrapElement(obj)

def unwrap(item):
	return UnwrapElement(item)

def ProcessList(_func, _list):
    return list(map(lambda x: ProcessList(_func, x) if type(x)==list else _func(x), _list ))

def rotate(elem, deg):
	pt = elem.Location.Point
	line = Line.ByStartPointEndPoint(Point.ByCoordinates(pt.X*fttomm,pt.Y*fttomm,pt.Z*fttomm),Point.ByCoordinates(pt.X*fttomm,pt.Y*fttomm,pt.Z*fttomm+1)).ToRevitType()
	# return elem.Location.Rotate(line, deg)
	ElementTransformUtils.RotateElement(doc, elem.Id, line, (deg*math.pi) / 180)
	return elem
	
elems = tolist(IN[0])
degs = tolist(IN[1])
	
# Start Transaction
TransactionManager.Instance.EnsureInTransaction(doc)
if len(elems) == len(degs):
	for elem, deg in zip(elems, degs):
		OUT.append(rotate(elem, deg))
else:
	deg = degs[0]
	for elem in elems:
		OUT.append(rotate(elem, deg))

# End Transaction
TransactionManager.Instance.TransactionTaskDone()


	
	
	
# ----------------------------------------
elements_2 = Output(python_script)  # "elements"
