# Dynamo custom node RIE_IndexDuplicateStrings.dyf (Dynamo 1.3.2.2480)
# category: RIE.List
# Indexes input list of strings with a running index for each set of duplicates

Strings = Input()
zFillAmount = Input(zFillAmount : int = 2)
Separator = Input(Separator : string = ".")
IndexUnique = Input(IndexUnique:bool=true)
StartIndex = Input(StartIndex: int = 1)
python_script = Python(IN[0]=Strings, IN[1]=zFillAmount, IN[2]=Separator, IN[3]=IndexUnique, IN[4]=StartIndex)
# ---------- python_script.python (37 lines) ----------
OUT = []
initstrings = []
indices = []
count = 0
outputstring = IN[0]
indexlist = []
for i in range(0, len(IN[0])):
	indexlist.append(None)
separator = IN[2]

if IN[3] == True:
	indexcheck = 0
else:
	indexcheck = 1


for string in IN[0]:
	initstrings.append(len(string))
	
for i in range(0, len(IN[0])):
	currentstring = IN[0][i]
	if not len(outputstring[i]) > initstrings[i]:
		for string in range(0, len(IN[0])):
			if currentstring == IN[0][string]:
				count += 1
				indices.append(string)
	if count > indexcheck:
		x = IN[4]
		for i in indices:
			outputstring[i] = IN[0][i]+separator+str(x).zfill(IN[1])
			indexlist[i] = str(x).zfill(IN[1])
			x += 1
		x = IN[4]
	count = 0
	indices = []

OUT = outputstring, indexlist
# ----------------------------------------
code_block = CodeBlock(seq=python_script) { seq[0]; seq[1]; }
IndexedStrings = Output(code_block.out0)
Indices = Output(code_block.out1)
