# Dynamo custom node RIE_InsertItemAtIndex.dyf (Dynamo 2.3.0.5885)
# category: RIE.List
# Inserts Items into list at given index

list = Input(list: var[]..[])
Item = Input(Item: var[]..[])
Index = Input(Index: var[]..[])
method = Input(method: bool = false)
python_script = Python(IN[0]=list, IN[1]=Item, IN[2]=Index, IN[3]=method)
# ---------- python_script.python (15 lines) ----------
# Python code implemented by kennyb6 https://forum.dynamobim.com/u/kennyb6

_list = IN[0]
elems = [x for _,x in sorted(zip(IN[2],IN[1]))]
keep = IN[3]

if keep:
	indices = [v+i for i,v in enumerate(sorted(IN[2]))]
else:
	indices = sorted(IN[2])

for ind, elem in zip(indices, elems):
	_list.insert(ind, elem)

OUT = _list
# ----------------------------------------
List = Output(python_script)
