# Dynamo custom node RIE_ItemAtIndexByMaximumKey.dyf (Dynamo 1.3.4.6666)
# category: RIE.List
# Retrieves maximum item based on key list value input.

Items = Input()
KeyVals = Input()
python_script = Python(IN[0]=Items, IN[1]=KeyVals)
# ---------- python_script.python (1 lines) ----------
OUT = IN[0][IN[1].index(max(IN[1]))]
# ----------------------------------------
Item = Output(python_script)
