# Dynamo custom node RIE_ItemAtIndexByMinimumKey.dyf (Dynamo 1.3.4.6666)
# category: RIE.List
# Filter a list based on another list of values, where the index of the highest "key value" is used to get the input item at the same index.

Items = Input()
KeyVals = Input()
python_script = Python(IN[0]=Items, IN[1]=KeyVals)
# ---------- python_script.python (1 lines) ----------
OUT = IN[0][IN[1].index(min(IN[1]))]
# ----------------------------------------
Item = Output(python_script)
