# Dynamo custom node RIE_LinkDocFromLink.dyf (Dynamo 1.3.3.4651)
# category: RIE.Elements
# Retrieves link Document element from link element.

LinkInstance = Input()
python_script = Python(IN[0]=LinkInstance)
# ---------- python_script.python (42 lines) ----------
import clr
clr.AddReference('ProtoGeometry')
from Autodesk.DesignScript.Geometry import *

# Import DocumentManager and TransactionManager
clr.AddReference("RevitServices")
import RevitServices
from RevitServices.Persistence import DocumentManager
from RevitServices.Transactions import TransactionManager

from System.Collections.Generic import *

# Import RevitAPI
clr.AddReference("RevitAPI")
import Autodesk
from Autodesk.Revit.DB import *
from Autodesk.Revit.DB.Analysis import *

doc = DocumentManager.Instance.CurrentDBDocument
uiapp = DocumentManager.Instance.CurrentUIApplication
app = uiapp.Application

# Import ToDSType(bool) extension method
clr.AddReference("RevitNodes")
import Revit
clr.ImportExtensions(Revit.Elements)

def tolist(obj):
	if isinstance(obj, list):
		return UnwrapElement(obj)
	else:
		return [UnwrapElement(obj)]

linkInstances = tolist(IN[0])

linkDoc = []
for i in linkInstances:
	linkDoc.append(i.GetLinkDocument())
if len(linkDoc) != 1:
	OUT = linkDoc
else:
	OUT = linkDoc[0]
# ----------------------------------------
LinkDoc = Output(python_script)
