# Dynamo custom node RIE_LinkedElementCategory.dyf (Dynamo 2.3.0.5885)
# category: RIE.Elements
# Returns Category of Linked Element

linkElement = Input(linkElement: var[]..[])
python_script = Python(IN[0]=linkElement)
# ---------- python_script.python (51 lines) ----------
#Copyright(c) 2014, Jason Andersen, andersen.ja@gmail.com
import clr

# Import RevitAPI
clr.AddReference("RevitAPI")
import Autodesk
from Autodesk.Revit.DB import *

# Import DocumentManager and TransactionManager
clr.AddReference("RevitServices")
import RevitServices
from RevitServices.Persistence import DocumentManager
from RevitServices.Transactions import TransactionManager

# Import ToDSType(bool) extension method
clr.AddReference("RevitNodes")
import Revit
clr.ImportExtensions(Revit.Elements)
clr.ImportExtensions(Revit.GeometryConversion)

import clr
clr.AddReference('ProtoGeometry')
from Autodesk.DesignScript.Geometry import *

doc =  DocumentManager.Instance.CurrentDBDocument
app =  DocumentManager.Instance.CurrentUIApplication.Application

def tolist(obj):
	if isinstance(obj, list):
		return UnwrapElement(obj)
	else:
		return [UnwrapElement(obj)]


#The input to this node will be stored in the IN[0] variable.
elements = tolist(IN[0])

#variables
output = []
catName = []

for item in elements:
	category1 = item.Category
	catName.append(category1.Name)  	    	

output.append(catName)

if len(catName) > 1:
	OUT = output
else:
	OUT = output[0]
# ----------------------------------------
byName = Category.ByName(name=python_script)
Category = Output(byName)
