# Dynamo custom node RIE_LinkedElementsByElementID.dyf (Dynamo 2.3.0.5885)
# category: RIE.Elements
# Get linked elements by element ID and link instance

LinkInstance = Input(LinkInstance: var[]..[])
ElementIDs = Input(ElementIDs: var[]..[])
refresh = Input(refresh: var[]..[])
python_script = Python(IN[0]=LinkInstance, IN[1]=ElementIDs, IN[2]=refresh)
# ---------- python_script.python (58 lines) ----------
# Copyright(c) 2017, Dimitar Venkov
# @5devene, dimitar.ven@gmail.com
# www.badmonkeys.net

import clr
import System

clr.AddReference("RevitNodes")
import Revit
clr.ImportExtensions(Revit.Elements)
clr.ImportExtensions(Revit.GeometryConversion)

clr.AddReference('RevitServices')
from RevitServices.Persistence import DocumentManager
from RevitServices.Transactions import TransactionManager
doc = DocumentManager.Instance.CurrentDBDocument

clr.AddReference('System')
from System.Collections.Generic import List

clr.AddReference("RevitAPI")
from Autodesk.Revit.DB import *


def tolist(obj1):
	if hasattr(obj1,"__iter__"): return obj1
	else: return [obj1]

links = UnwrapElement(tolist(IN[0]))
#eleId = IN[1]
eleId=[]
for i in UnwrapElement(tolist(IN[1])):
	eleId.append(ElementId(int(i)))
	

elemIds = List[ElementId](eleId)
elements, transforms = [], []
elout = []
elemelons = []
elementer = []

for link in links:

	if RevitLinkType.IsLoaded(doc, link.GetTypeId() ):
		linkDoc = link.GetLinkDocument()
		fec = FilteredElementCollector(linkDoc,elemIds)
		elout = fec.WhereElementIsNotElementType().ToElements()
		transforms.append(link.GetTotalTransform().ToCoordinateSystem(True) )			
	else:
		elements.append('Linked document is unloaded')
		transforms.append(None)
	for _ in elout:
		elemelons.append(_.ToDSType(True))
	elout=[]
	elementer.append(elemelons)
	elemelons=[]

OUT = elementer, transforms, links
# ----------------------------------------
code_block = CodeBlock(a=python_script) { a[0]; a[1]; a[2]; }
Transforms = Output(code_block.out1)
Link = Output(code_block.out2)
code_block_2 = CodeBlock { 1; }
flatten = List.Flatten(list=code_block.out0, amt=code_block_2)
Elements = Output(flatten)
