# Dynamo custom node RIE_Math_MRound.dyf (Dynamo 2.3.0.5885)
# category: RIE.List
# Rounds given numbers to nearest input multiple

multiple = Input(multiple: var[]..[])
code_block = CodeBlock(A=multiple) { A<1; A>-1; }
join = List.Join(list0=code_block.out0, list1=code_block.out1)
allTrue = List.AllTrue(list=join)
number = Input(number: var[]..[])
div = number / multiple
round = Math.Round(number=div)
mul = round * multiple
round_2 = Math.Round(number=number)
div_2 = round_2 / multiple
round_3 = Math.Round(number=div_2)
mul_2 = round_3 * multiple
if_ = If(test=allTrue, true=mul, false=mul_2)
Rounded = Output(if_)
