# Dynamo custom node RIE_Math_MRound_Ceiling.dyf (Dynamo 2.3.0.5885)
# category: RIE.List
# Rounds input value to nearest multiple, but ceilinged (Round up)

multiple = Input(multiple: var[]..[])
code_block = CodeBlock(A=multiple) { A<1; A>-1; }
join = List.Join(list0=code_block.out0, list1=code_block.out1)
allTrue = List.AllTrue(list=join)
number = Input(number: var[]..[])
div = number / multiple
ceiling = Math.Ceiling(number=div)
mul = ceiling * multiple
round = Math.Round(number=number)
div_2 = round / multiple
ceiling_2 = Math.Ceiling(number=div_2)
mul_2 = ceiling_2 * multiple
if_ = If(test=allTrue, true=mul, false=mul_2)
Rounded = Output(if_)
