# Dynamo custom node RIE_ModelComparison_ByView.dyf (Dynamo 2.3.0.5885)
# category: RIE.ModelComparison
# Modified version of Data-Shapes Model Comparison node. Compares two versions of a model by input views, and reports on new and deleted elements.

CurDoc = Input(CurDoc: var = false)  # Most recent version of the model, current document by default
PrevDoc = Input(PrevDoc: var[]..[])  # Previous version of the model
categories = Input(categories: var[]..[])
views = Input(views: var[]..[])
python_script = Python(IN[0]=CurDoc, IN[1]=PrevDoc, IN[2]=categories, IN[3]=views)
# ---------- python_script.python (75 lines) ----------
import clr
clr.AddReference('RevitAPI')
from Autodesk.Revit.DB import*
clr.AddReference('RevitServices')
from RevitServices.Persistence import DocumentManager
import System
from System.Collections.Generic import*

def tolist(obj):
	if isinstance(obj, list):
		return UnwrapElement(obj)
	else:
		return [UnwrapElement(obj)]
		
if IN[0] == False:
	docA = DocumentManager.Instance.CurrentDBDocument
else:
	docA = IN[0]
docB = UnwrapElement(IN[1])
CategorySet = IN[2]
views = tolist(IN[3])
OUT = []

def reportformat(x):
	val = [UnwrapElement(e).Category.Name for e in x]
	values = set(val)
	newlist = [len([y for y in val if y==x]) for x in values]
	strreport = []
	for i,j in zip(values,newlist):
		strreport.append('%d %s element(s)'%(j,i))
	return ', '.join(strreport)
	
#getting list of categories

if isinstance(IN[2],list):
	categories = IN[2]
else:
	categories = [IN[2]]

#Getting All elements of wanted category set

catfilters = []
for i in categories:
	catfilters.append(ElementCategoryFilter(System.Enum.ToObject(BuiltInCategory, int(str(i.Id)))))


catfilterlist = List[ElementFilter](catfilters)
filter = LogicalOrFilter(catfilterlist)

for view in views:

	docAcollector = FilteredElementCollector(docA, view.Id).WherePasses(filter).WhereElementIsNotElementType().ToElements()
	docBcollector = FilteredElementCollector(docB, view.Id).WherePasses(filter).WhereElementIsNotElementType().ToElements()
	
	#GUID lists
	
	docAguid = [e.UniqueId for e in docAcollector]
	docBguid = [e.UniqueId for e in docBcollector]
	
	#Sorting existing elements, new elements and deleted elements
	
	existingguid = [e for e in docAguid if e in docBguid]
	newguid = [e for e in docAguid if e not in docBguid]
	deletedguid = [e for e in docBguid if e not in docAguid]
	
	existingA = [docA.GetElement(e) for e in existingguid]
	existingB = [docB.GetElement(e) for e in existingguid]
	new = [docA.GetElement(e) for e in newguid]
	deleted = [docB.GetElement(e) for e in deletedguid]
	newreport = reportformat(new)
	deletedreport = reportformat(deleted)
	
	report = 'The given view in the model contains %d elements of the selected categories, there are %d new elements and %d deleted elements compared to the previous indice. \nNew elements : ' %(len(docAcollector),len(new),len(deleted)) + newreport + '\nDeleted elements : ' + deletedreport
	stuff = (existingA, existingB) ,  new, deleted, report
	OUT.append(stuff)
# ----------------------------------------
code_block = CodeBlock { 0; 1; 2; 3; }
getItemAtIndex = List.GetItemAtIndex(index=code_block.out3)  # unwired: list
map = List.Map(list=python_script, f_x=getItemAtIndex)
Report = Output(map)
getItemAtIndex_2 = List.GetItemAtIndex(index=code_block.out0)  # unwired: list
map_2 = List.Map(list=python_script, f_x=getItemAtIndex_2)
Existing_elements_Data = Output(map_2)
getItemAtIndex_3 = List.GetItemAtIndex(index=code_block.out1)  # unwired: list
map_3 = List.Map(list=python_script, f_x=getItemAtIndex_3)
New_elements = Output(map_3)
getItemAtIndex_4 = List.GetItemAtIndex(index=code_block.out2)  # unwired: list
map_4 = List.Map(list=python_script, f_x=getItemAtIndex_4)
Deleted_elements = Output(map_4)
