# Dynamo custom node RIE_RemoveNulls.dyf (Dynamo 2.3.0.5885)
# category: RIE.List
# Removes Nulls from list, and outputs a clean list as well as a list of indices that contained nulls in input list

list = Input(list: var[]..[])
python_script = Python(IN[0]=list)
# ---------- python_script.python (9 lines) ----------
items = []
indices = []
for _ in range(0,len(IN[0])):
	if not IN[0][_] == None:
		items.append(IN[0][_])
	else:
		indices = _
		
OUT = items, indices
# ----------------------------------------
code_block = CodeBlock(a=python_script) { a[0]; a[1]; }
CleanList = Output(code_block.out0)
NullIndices = Output(code_block.out1)
