# Dynamo custom node RIE_ReplaceItemsAtIndices.dyf (Dynamo 2.3.0.5885)
# category: RIE.List
# Replaces items at indices with input value. One value for each index needed.

list = Input(list: var[]..[])
Indices = Input(Indices: var[]..[])
Item = Input(Item: var[]..[])
python_script = Python(IN[0]=list, IN[1]=Indices, IN[2]=Item)
# ---------- python_script.python (23 lines) ----------
import clr
clr.AddReference('ProtoGeometry')
from Autodesk.DesignScript.Geometry import *
#The inputs to this node will be stored as a list in the IN variables.

def tolist(obj):
	if isinstance(obj, list):
		return UnwrapElement(obj)
	else:
		return [UnwrapElement(obj)]

OUT = []

indices = []

for ind in tolist(IN[1]):
	indices.append(int(ind))

for i in range(0, len(tolist(IN[0]))):
	if i in indices:
		OUT.append(IN[2])
	else:
		OUT.append(IN[0][i])
# ----------------------------------------
List = Output(python_script)
