# Dynamo custom node RIE_RevisionsOnSheet.dyf (Dynamo 1.3.3.4651)
# category: RIE.Revisions
# Returns Revisions that are placed on a sheet.

Sheet = Input()
python_script = Python(IN[0]=Sheet)
# ---------- python_script.python (46 lines) ----------
import clr
# Import RevitAPI
clr.AddReference("RevitAPI")
import Autodesk
from Autodesk.Revit.DB import *

import Autodesk
clr.AddReference("RevitNodes")
import Revit
clr.ImportExtensions(Revit.Elements)

# Import DocumentManager and TransactionManager
clr.AddReference("RevitServices")
import RevitServices
from RevitServices.Persistence import DocumentManager
from RevitServices.Transactions import TransactionManager
# Import geometry conversion extension methods
clr.ImportExtensions(Revit.GeometryConversion)
# Import Element wrapper extension methods
clr.ImportExtensions(Revit.Elements)

# Define active document, active UI interface, and active application instance.
doc = DocumentManager.Instance.CurrentDBDocument
uiapp = DocumentManager.Instance.CurrentUIApplication
app = uiapp.Application

def tolist(obj):
	if isinstance(obj, list):
		return UnwrapElement(obj)
	else:
		return [UnwrapElement(obj)]

OUT = []
SheetRevs = []


xs = tolist(IN[0])
	
for x in xs:
	SheetRevs.append(x.GetAllRevisionIds())

for lst in SheetRevs:
	elementlist = []
	for rev in lst:
		elementlist.append(doc.GetElement(rev).ToDSType(True))
	OUT.append(elementlist)
# ----------------------------------------
Revisions = Output(python_script)
