# Dynamo custom node RIE_SelectElementById.dyf (Dynamo 2.3.0.5885)
# category: RIE.Elements
# Forked from Clockwork

elementIds_or_Ints = Input(elementIds_or_Ints: var[]..[])
python_script = Python(IN[0]=elementIds_or_Ints)
# ---------- python_script.python (41 lines) ----------
import clr
clr.AddReference('RevitAPI')
from Autodesk.Revit.DB import *

clr.AddReference("RevitNodes")
import Revit
clr.ImportExtensions(Revit.Elements)

clr.AddReference("RevitServices")
import RevitServices
from RevitServices.Persistence import DocumentManager

doc = DocumentManager.Instance.CurrentDBDocument

if isinstance(IN[0], list):
	items = UnwrapElement(IN[0])
else:
	items = [UnwrapElement(IN[0])]

i = 0

elementlist = list()
elementlistfull = list()
unmatched = list()
for item in items:
	try: 
		elementlist.append(doc.GetElement(int(item.ToString())).ToDSType(True))
		elementlistfull.append(doc.GetElement(int(item.ToString())).ToDSType(True))
	except:
		try:
			elementlist.append(doc.GetElement(ElementId(int(item.ToString()))).ToDSType(True))
			elementlistfull.append(doc.GetElement(ElementId(int(item.ToString()))).ToDSType(True))
		except:
			try:
				unmatched.append(int(item.ToString()))
				elementlistfull.append(i)
			except:
				unmatched.append("Not int value")
				elementlistfull.append(i)
	i+=1
OUT = (elementlist, unmatched, elementlistfull)
# ----------------------------------------
code_block = CodeBlock(a=python_script) { a[0]; }
Elements = Output(code_block)
code_block_2 = CodeBlock(a=python_script) { a[1]; }
Unmatched = Output(code_block_2)
code_block_3 = CodeBlock(a=python_script) { a[2]; }
ElementsFullList = Output(code_block_3)
