# Dynamo custom node RIE_SelectPanel.dyf (Dynamo 2.3.0.5885)
# category: RIE.Power
# Assigns Electrical System (cirucit) to a panel and assigns the circuit an automatic running index number

circuit = Input(circuit: var[]..[])
panel = Input(panel: var[]..[])
python_script = Python(IN[0]=circuit, IN[1]=panel)
# ---------- python_script.python (51 lines) ----------
import clr
clr.AddReference('ProtoGeometry')
from Autodesk.DesignScript.Geometry import *

clr.AddReference('RevitServices')
import RevitServices
from RevitServices.Persistence import DocumentManager
from RevitServices.Transactions import TransactionManager
from System.Collections.Generic import *

clr.AddReference('RevitNodes')
import Revit
clr.ImportExtensions(Revit.Elements)

clr.AddReference('RevitAPI')
import Autodesk
from Autodesk.Revit.DB import *
from Autodesk.Revit.DB.Electrical import *
from Autodesk.Revit.DB import MEPSystem

clr.AddReference('DSCoreNodes')
import DSCore
from DSCore.List import *

import sys
pyt_path = r'C:\Program Files (x86)\IronPython 2.7\Lib'
sys.path.append(pyt_path)

# Import List ( ICollection(ElementId) = List[ElementId]() )
clr.AddReference("System")
from System.Collections.Generic import List 


circuit = UnwrapElement(IN[0])
panel = UnwrapElement(IN[1])

doc = DocumentManager.Instance.CurrentDBDocument
uiapp = DocumentManager.Instance.CurrentUIApplication
app = uiapp.Application
uidoc = DocumentManager.Instance.CurrentUIApplication.ActiveUIDocument

TransactionManager.Instance.EnsureInTransaction(doc)

for _ in circuit:
	_.SelectPanel(panel)

TransactionManager.Instance.TransactionTaskDone()

#Assign your output to the OUT variable.
OUT = []
OUT = circuit, panel
# ----------------------------------------
code_block = CodeBlock(a=python_script) { a[0]; }
Circuit = Output(code_block)
code_block_2 = CodeBlock(a=python_script) { a[1]; }
Panel = Output(code_block_2)
