# Dynamo custom node RIE_Set3DViewSectionBox.dyf (Dynamo 2.3.0.5885)
# category: RIE.Views
# Sets sectionbox of 3D view and if the view is open, also zooms to its extents.

views = Input(views: var[]..[])
BBoxes = Input(BBoxes: var[]..[])
python_script = Python(IN[0]=views, IN[1]=BBoxes)
# ---------- python_script.python (57 lines) ----------
import clr
clr.AddReference('ProtoGeometry')
from Autodesk.DesignScript.Geometry import *
#The inputs to this node will be stored as a list in the IN variables.

clr.AddReference('RevitAPI')
from Autodesk.Revit.DB import *

clr.AddReference('RevitAPIUI')
from  Autodesk.Revit.UI import UIView

clr.AddReference("RevitNodes")
import Revit
# Import ToProtoType, ToRevitType geometry conversion extension methods
clr.ImportExtensions(Revit.GeometryConversion)
clr.ImportExtensions(Revit.Elements)

# Import DocumentManager and TransactionManager
clr.AddReference("RevitServices")
import RevitServices
from RevitServices.Persistence import DocumentManager
from RevitServices.Transactions import TransactionManager

doc = DocumentManager.Instance.CurrentDBDocument
uidoc=DocumentManager.Instance.CurrentUIApplication.ActiveUIDocument

if isinstance(IN[0], list):
	view = IN[0]
else:
	view = [IN[0]]

if isinstance(IN[1], list):
	bbox = IN[1]
else:
	bbox = [IN[1]]

OUT = []
	
for _ in range(0, len(view)):
	curview = UnwrapElement(view[_])
	curbbox = UnwrapElement(bbox[_])
	try:
		TransactionManager.Instance.EnsureInTransaction(doc)
		curview.SetSectionBox(curbbox.ToRevitType())
		TransactionManager.Instance.TransactionTaskDone()
		OUT.append(curview)
	except:
		OUT.append("Failed")
		
	for uv in uidoc.GetOpenUIViews():
		if uv.ViewId.Equals( curview.Id ):
			uiview = uv
		break
	try:
		uiview.ZoomToFit()
	except:
		error = 1
# ----------------------------------------
Views = Output(python_script)
