# Dynamo custom node RIE_SetRevisionDescription.dyf (Dynamo 2.3.0.5885)
# category: RIE.Revisions
# Sets description of input revision

revision = Input(revision: var[]..[])
Description = Input(Description: string)
python_script_description = Python(IN[0]=revision, IN[1]=Description)
# ---------- python_script_description.python (64 lines) ----------
import sys
#pyt_path = r"C:\Program Files (x86)\IronPython 2.7\DLLs"
#sys.path.append(pyt_path)
import clr

#clr.AddReference('IronPython.SQLite.dll')
pyt_path = r"C:\Program Files (x86)\IronPython 2.7\Lib"
sys.path.append(pyt_path)
#import sqlite3

# Import ToDSType(bool) extension method
clr.AddReference('RevitNodes')
import Revit
clr.ImportExtensions(Revit.GeometryConversion)
clr.ImportExtensions(Revit.Elements)

# Import DocumentManager and TransactionManager
clr.AddReference('RevitServices')
import RevitServices
from RevitServices.Persistence import DocumentManager
from RevitServices.Transactions import TransactionManager

doc = DocumentManager.Instance.CurrentDBDocument
uidoc = DocumentManager.Instance.CurrentUIApplication.ActiveUIDocument
app = DocumentManager.Instance.CurrentUIApplication.Application

# Import List ( ICollection(ElementId) = List[ElementId]() )
clr.AddReference('System')
from System.Collections.Generic import List

# Import Revit API + APIUI
clr.AddReference('RevitAPI')
from Autodesk.Revit.DB import *
from Autodesk.Revit.DB.Electrical import *

clr.AddReference('RevitAPIUI')
from Autodesk.Revit.UI import *

OUT = []

def tolist(obj):
	if isinstance(obj, list):
		return UnwrapElement(obj)
	else:
		return [UnwrapElement(obj)]

def setvalue(rev,description):
	rev.Description = description
	return description

TransactionManager.Instance.EnsureInTransaction(doc)

if isinstance(IN[1], list):
	if len(IN[1]) == len(IN[0]):
		for i,j in zip(tolist(IN[0]),tolist(IN[1])):
			OUT.append(setvalue(i,j))
	else:
		for i in tolist(IN[0]):
			OUT.append(setvalue(i,IN[1][0]))
else:
	for i in tolist(IN[0]):
		OUT.append(setvalue(i,IN[1]))
	
TransactionManager.Instance.TransactionTaskDone()
# ----------------------------------------
Description_2 = Output(python_script_description)  # "Description"
