# Dynamo custom node RIE_SetRevisionVisibility.dyf (Dynamo 2.3.0.5885)
# category: RIE.Revisions
# Sets Revision Visibility based on input string. Cloud and Tag, Tag or None.

revision = Input(revision: var[]..[])
Visibility = Input(Visibility: string)
python_script_revvis = Python(IN[0]=revision, IN[1]=Visibility)
# ---------- python_script_revvis.python (74 lines) ----------
import sys
#pyt_path = r"C:\Program Files (x86)\IronPython 2.7\DLLs"
#sys.path.append(pyt_path)
import clr

#clr.AddReference('IronPython.SQLite.dll')
pyt_path = r"C:\Program Files (x86)\IronPython 2.7\Lib"
sys.path.append(pyt_path)
#import sqlite3

# Import ToDSType(bool) extension method
clr.AddReference('RevitNodes')
import Revit
clr.ImportExtensions(Revit.GeometryConversion)
clr.ImportExtensions(Revit.Elements)

# Import DocumentManager and TransactionManager
clr.AddReference('RevitServices')
import RevitServices
from RevitServices.Persistence import DocumentManager
from RevitServices.Transactions import TransactionManager

doc = DocumentManager.Instance.CurrentDBDocument
uidoc = DocumentManager.Instance.CurrentUIApplication.ActiveUIDocument
app = DocumentManager.Instance.CurrentUIApplication.Application

# Import List ( ICollection(ElementId) = List[ElementId]() )
clr.AddReference('System')
from System.Collections.Generic import List

# Import Revit API + APIUI
clr.AddReference('RevitAPI')
from Autodesk.Revit.DB import *
from Autodesk.Revit.DB.Electrical import *

clr.AddReference('RevitAPIUI')
from Autodesk.Revit.UI import *

OUT = []

def tolist(obj):
	if isinstance(obj, list):
		return UnwrapElement(obj)
	else:
		return [UnwrapElement(obj)]

def setvalue(rev,revVis):
	if revVis == "None" or revVis == "Hidden":
		rev.Visibility = RevisionVisibility.Hidden
	elif revVis == "Cloud and Tag" or revVis == "CloudAndTagVisible":
		rev.Visibility = RevisionVisibility.CloudAndTagVisible
	elif revVis == "Tag"  or revVis == "TagVisible":
		rev.Visibility = RevisionVisibility.TagVisible
	else:
		try:
			rev.Visibility = RevisionVisibility.revVis
		except:
			return "Input value not valid. Try None, Cloud and Tag, Tag, Hidden, CloudAndTagVisible or TagVisible as input value(s)."
	return revVis

TransactionManager.Instance.EnsureInTransaction(doc)

if isinstance(IN[1], list):
	if len(IN[1]) == len(IN[0]):
		for i,j in zip(tolist(IN[0]),tolist(IN[1])):
			OUT.append(setvalue(i,j))
	else:
		for i in tolist(IN[0]):
			OUT.append(setvalue(i,IN[1][0]))
else:
	for i in tolist(IN[0]):
		OUT.append(setvalue(i,IN[1]))
	
TransactionManager.Instance.TransactionTaskDone()
# ----------------------------------------
Visibility_2 = Output(python_script_revvis)  # "Visibility"
