# Dynamo custom node RIE_SheetsContainingRevision.dyf (Dynamo 2.3.0.5885)
# category: RIE.Revisions
# Returns all sheets in the model that contains the input revision
# packages: RIE 0.7.1

categories = Categories("OST_Sheets")  # graph input
all_elements_of_category = ElementsOfCategory(Category=categories)
revisionsOnSheet = Custom[RIE.RevisionsOnSheet](Sheet=all_elements_of_category)  # package RIE; Returns Revisions that are placed on a sheet.
revision = Input(revision: var[]..[])
contains = List.Contains(list=revisionsOnSheet@L2, item=revision)
transpose = List.Transpose(lists=contains)
filterByBoolMask = List.FilterByBoolMask(list=all_elements_of_category, mask=transpose@L2)
python_script = Python(IN[0]=filterByBoolMask.in)
# ---------- python_script.python (11 lines) ----------
import clr
clr.AddReference('ProtoGeometry')
from Autodesk.DesignScript.Geometry import *
#The inputs to this node will be stored as a list in the IN variables.
dataEnteringNode = IN

#Assign your output to the OUT variable.
if len(IN[0]) > 1:
	OUT = IN[0]
else:
	OUT = IN[0][0]
# ----------------------------------------
Sheets = Output(python_script)
