# Dynamo custom node RIE_WaitFor.dyf (Dynamo 1.3.2.2480)
# category: RIE.List
# Waits for "GO input" before passing through main input

Passthrough = Input()
WaitFor = Input()
create = List.Create(Passthrough, WaitFor)
code_block = CodeBlock(a=create) { a[0]; }
Passthrough_2 = Output(code_block)  # "Passthrough"
