# Dynamo custom node RIE_Wall_GetDirections.dyf (Dynamo 2.3.1.11775)
# category: RIE.Elements
# Returns Vectors for Wall direction, Walls interior side normal, Walls exterior side normal

walls = Input(walls: var[]..[])
python_script = Python(IN[0]=walls)
# ---------- python_script.python (46 lines) ----------
# @ Copyright - Designed by André Abotnes andre.abotnes@norconsult.com
import sys
#pyt_path = r"C:\Program Files (x86)\IronPython 2.7\DLLs"
#sys.path.append(pyt_path)
import clr

# Import ToDSType(bool) extension method
clr.AddReference('RevitNodes')
import Revit
clr.ImportExtensions(Revit.GeometryConversion)
clr.ImportExtensions(Revit.Elements)

# Import DesignScript.Geometry
clr.AddReference('ProtoGeometry')
from Autodesk.DesignScript.Geometry import *

# Import DocumentManager and TransactionManager
clr.AddReference('RevitServices')
import RevitServices
from RevitServices.Persistence import DocumentManager
from RevitServices.Transactions import TransactionManager

doc = DocumentManager.Instance.CurrentDBDocument
uidoc = DocumentManager.Instance.CurrentUIApplication.ActiveUIDocument
app = DocumentManager.Instance.CurrentUIApplication.Application

# Import Revit API + APIUI
clr.AddReference('RevitAPI')
from Autodesk.Revit.DB import *
from Autodesk.Revit.DB.Electrical import *

clr.AddReference('RevitAPIUI')
from Autodesk.Revit.UI import *

def tolist(obj):
	if isinstance(obj, list):
		return UnwrapElement(obj)
	else:
		return [UnwrapElement(obj)]

walls = tolist(IN[0])

OUT = []

for wall in walls:
	OUT.append([wall.Location.Curve.Direction.ToVector(), wall.Orientation.ToVector(), wall.Orientation.Negate().ToVector()])
# ----------------------------------------
transpose = List.Transpose(lists=python_script)
code_block = CodeBlock(l=transpose) { l[0]; l[1]; l[2]; }
direction = Output(code_block.out0)
exterior_normal = Output(code_block.out1)
interior_normal = Output(code_block.out2)
