# Dynamo custom node RIE_Wall_GetLocations.dyf (Dynamo 2.3.1.11775)
# category: RIE.Elements
# Returns Lines for Exterior, Interior, Center and CoreCenter of a wall

walls = Input(walls: var[]..[])
python_script = Python(IN[0]=walls)
# ---------- python_script.python (75 lines) ----------
# @ Copyright - Designed by André Abotnes andre.abotnes@norconsult.com
import sys
#pyt_path = r"C:\Program Files (x86)\IronPython 2.7\DLLs"
#sys.path.append(pyt_path)
import clr

# Import ToDSType(bool) extension method
clr.AddReference('RevitNodes')
import Revit
clr.ImportExtensions(Revit.GeometryConversion)
clr.ImportExtensions(Revit.Elements)

# Import DesignScript.Geometry
clr.AddReference('ProtoGeometry')
from Autodesk.DesignScript.Geometry import *

# Import DocumentManager and TransactionManager
clr.AddReference('RevitServices')
import RevitServices
from RevitServices.Persistence import DocumentManager
from RevitServices.Transactions import TransactionManager

doc = DocumentManager.Instance.CurrentDBDocument
uidoc = DocumentManager.Instance.CurrentUIApplication.ActiveUIDocument
app = DocumentManager.Instance.CurrentUIApplication.Application

# Import Revit API + APIUI
clr.AddReference('RevitAPI')
from Autodesk.Revit.DB import *
from Autodesk.Revit.DB.Electrical import *

clr.AddReference('RevitAPIUI')
from Autodesk.Revit.UI import *

def tolist(obj):
	if isinstance(obj, list):
		return UnwrapElement(obj)
	else:
		return [UnwrapElement(obj)]

walls = tolist(IN[0])

OUT = []

for wall in walls:
	compoundStructure = doc.GetElement(wall.GetTypeId()).GetCompoundStructure()
	layers = compoundStructure.GetLayers()
	exteriorside = True
	exteriorwidth=0
	interiorwidth=0
	for layer in layers:
		if compoundStructure.IsCoreLayer(layer.LayerId):
			exteriorside = False
			exteriorwidth += (layer.Width*304.8)/2
			interiorwidth += (layer.Width*304.8)/2
		else:
			if exteriorside:
				exteriorwidth += layer.Width*304.8
			if not exteriorside:
				interiorwidth += layer.Width*304.8
	wallCurve = wall.Location.Curve.ToProtoType()
	if exteriorwidth > interiorwidth:
		difference = exteriorwidth - interiorwidth
		coreCenterVector = wall.Orientation.Negate().ToVector()
	else:
		difference = interiorwidth - exteriorwidth
		coreCenterVector = wall.Orientation.ToVector()
	if difference > 0:
		coreCenterCurve = wallCurve.Translate(coreCenterVector, difference/2)
	else:
		coreCenterCurve = wallCurve
	
	extWallCurve = wallCurve.Translate(wall.Orientation.Negate().ToVector(), wall.Width*304.8/2)
	intWallCurve = wallCurve.Translate(wall.Orientation.ToVector(), wall.Width*304.8/2)
	OUT.append([extWallCurve, intWallCurve, wallCurve, coreCenterCurve])
# ----------------------------------------
transpose = List.Transpose(lists=python_script)
code_block = CodeBlock(l=transpose) { l[0]; l[1]; l[2]; l[3]; }
external_line = Output(code_block.out0)
interior_line = Output(code_block.out1)
center_line = Output(code_block.out2)
core_center_line = Output(code_block.out3)
