# Dynamo custom node __Arc_By_Points_and_Radius.dyf "❄_Arc By Points and Radius" (Dynamo 2.0.3.8810)
# category: Sastrugi.Curves
# (Sastrugi_Curves) This node creates an Arc using Start / End Points and a Radius. Options to Mirror and create the Arc on a specific Plane are included.

# group: Inputs
StartPoint = Input(StartPoint: Autodesk.DesignScript.Geometry.Point)
EndPoint = Input(EndPoint: Autodesk.DesignScript.Geometry.Point)
Radius = Input(Radius: var[]..[])  # Must be more than half the distance between Start and End Points.
Mirror = Input(Mirror: bool = false)
ArcPlane = Input(ArcPlane: Autodesk.DesignScript.Geometry.Plane = null)  # Default XY Plane when Point Z values are equal. Otherwise a specified Plane will be required for placement.

# group: Geometry Creation
code_block = CodeBlock(SP=StartPoint, EP=EndPoint, RAD=Radius, MIRROR=Mirror, PLANE=ArcPlane) { SP; EP; RAD; MIRROR; PLANE; }
distanceTo = Geometry.DistanceTo(geometry=code_block.SP, other=code_block.EP)
code_block_2 = CodeBlock(DIST=distanceTo) { DIST/2; }
code_block_3 = CodeBlock(SP=code_block.SP, EP=code_block.EP) { SP.Z; EP.Z; }
eq = code_block_3.out0 == code_block_3.out1
isNull = Object.IsNull(obj=code_block.PLANE)
XY = Plane.XY()
code_block_4 = CodeBlock(p=isNull, thru1=code_block.PLANE, thru2=XY)
# ---------- code_block_4.designscript (3 lines) ----------
p==false?
thru1:
thru2;
# ----------------------------------------
normal = Plane.Normal(plane=code_block_4)
byCenterPointRadiusNormal = Circle.ByCenterPointRadiusNormal(centerPoint=code_block.EP, radius=code_block.RAD, normal=normal)
byCenterPointRadiusNormal_2 = Circle.ByCenterPointRadiusNormal(centerPoint=code_block.SP, radius=code_block.RAD, normal=normal)
intersect = Geometry.Intersect(geometry=byCenterPointRadiusNormal, other=byCenterPointRadiusNormal_2)
byCenterPointRadiusNormal_3 = Circle.ByCenterPointRadiusNormal(centerPoint=intersect, radius=code_block.RAD, normal=normal)
byStartPointEndPoint = Line.ByStartPointEndPoint(startPoint=code_block.SP, endPoint=code_block.EP)
code_block_5 = CodeBlock { 0.5; }
planeAtParameter = Curve.PlaneAtParameter(curve=byStartPointEndPoint, param=code_block_5)
intersect_2 = Geometry.Intersect(geometry=byCenterPointRadiusNormal_3, other=planeAtParameter)
byThreePoints = Arc.ByThreePoints(firstPoint=code_block.SP, secondPoint=intersect_2, thirdPoint=code_block.EP)
length = Curve.Length(curve=byThreePoints)
sortIndexByValue = List.SortIndexByValue(list=length)
firstItem = List.FirstItem(list=sortIndexByValue@L2)
getItemAtIndex = List.GetItemAtIndex(list=byThreePoints@L2, index=firstItem@L1)
code_block_6 = CodeBlock(MIRROR=code_block.MIRROR)
# ---------- code_block_6.designscript (3 lines) ----------
MIRROR==true?
1:
0;
# ----------------------------------------
getItemAtIndex_2 = List.GetItemAtIndex(list=getItemAtIndex, index=code_block_6)
code_block_7 = CodeBlock(RAD=code_block.RAD, DIST=code_block_2, PPEQ=eq, PPL=isNull, ARCOUT=getItemAtIndex_2)
# ---------- code_block_7.designscript (5 lines) ----------
RAD<DIST?
"Error: Radius to small!":
PPEQ==false && PPL==true?
"Error: Please specify a Plane containing these points!":
ARCOUT;
# ----------------------------------------
Arc = Output(code_block_7)
