# Dynamo custom node __Convert_Dynamo_XYZ_to_Revit_Coordinate_XYZ.dyf "❄_Convert Dynamo XYZ to Revit Coordinate XYZ" (Dynamo 2.0.3.8810)
# category: Sastrugi.Points
# (Sastrugi_Points) Convert a Point (XYZ) in Dynamo to Revit Shared Coordinates (XYZ).

PointX = Input(PointX: var[]..[])
PointY = Input(PointY: var[]..[])
code_block = CodeBlock { 0; }
byCoordinates = Point.ByCoordinates(x=PointX, y=PointY, z=code_block)
identity = CoordinateSystem.Identity()
element_types = ElementTypes(index=26)  # graph input
all_elements_of_type = ElementsOfType(element_type=element_types)
lastItem = List.LastItem(list=all_elements_of_type)
code_block_2 = CodeBlock()
# ---------- code_block_2.designscript (2 lines) ----------
["E/W","N/S","Elev",
"Angle to True North"];
# ----------------------------------------
getParameterValueByName = Element.GetParameterValueByName(element=lastItem, parameterName=code_block_2)
code_block_3 = CodeBlock(bp=getParameterValueByName) { bp[0]; bp[1]; bp[2]; 360-bp[3]; }
byOrigin = CoordinateSystem.ByOrigin(x=code_block_3.out0, y=code_block_3.out1, z=code_block_3.out2)
origin = CoordinateSystem.Origin(coordinateSystem=byOrigin)
ZAxis = Vector.ZAxis()
rotate = CoordinateSystem.Rotate(coordinateSystem=byOrigin, origin=origin, axis=ZAxis, degrees=code_block_3.out3)
transform = Geometry.Transform(geometry=byCoordinates, fromCoordinateSystem=identity, contextCoordinateSystem=rotate)
Y = Point.Y(point=transform)
N_S = Output(Y)  # "N/S"
X = Point.X(point=transform)
E_W = Output(X)  # "E/W"
PointZ = Input(PointZ: var[]..[])
code_block_4 = CodeBlock(a=code_block_3.out2, b=PointZ) { a+b; }
Elev = Output(code_block_4)
