# Dynamo custom node __Find_Elements_with_Overridden_Graphics.dyf "❄_Find Elements with Overridden Graphics" (Dynamo 2.2.1.5175)
# category: Sastrugi.Graphics
# (Sastrugi_Graphics) This node will inspect Elements and determine if they have any overrides applied to them in the reference View.

Elements = Input(Elements: var[]..[])
ViewList = Input(ViewList: var[]..[])
python_script = Python(IN[0]=Elements, IN[1]=ViewList)
# ---------- python_script.python (30 lines) ----------
import clr

clr.AddReference('RevitAPI')
from Autodesk.Revit.DB import *

elements = UnwrapElement(IN[0])
view = UnwrapElement(IN[1])

OUT = []
for element in elements:
	o = view.GetElementOverrides(element.Id)
	OUT.append(
	not any([
	o.CutFillColor.IsValid, 
	o.CutFillPatternId.IntegerValue > 0, 
	o.CutLineColor.IsValid, 
	o.CutLinePatternId.IntegerValue > 0, 
	o.CutLineWeight > 0, 
	o.DetailLevel.ToString() != "Undefined",
	o.Halftone,	
	not(o.IsCutFillPatternVisible),
	not(o.IsProjectionFillPatternVisible), 
	o.ProjectionFillColor.IsValid, 
	o.ProjectionFillPatternId.IntegerValue > 0, 
	o.ProjectionLineColor.IsValid, 
	o.ProjectionLinePatternId.IntegerValue > 0, 
	o.ProjectionLineWeight > 0, 
	o.Transparency != 0
	])
	)
# ----------------------------------------
filterByBoolMask = List.FilterByBoolMask(list=Elements, mask=python_script)
OverriddenElements = Output(filterByBoolMask.out)
python_script_2 = Python()  # unwired: IN[0]
# ---------- python_script_2.python (9 lines) ----------
import clr
clr.AddReference('ProtoGeometry')
from Autodesk.DesignScript.Geometry import *
#The inputs to this node will be stored as a list in the IN variables.
dataEnteringNode = IN

list = "CutFillColor","CutFillPattern","CutLineColor","CutLinePattern","CutLineWeight","DetailLevel","Halftone","CutFillPatternVisible","ProjectionFillPatternVisible","ProjectionFillColor","ProjectionFillPattern","ProjectionLineColor","ProjectionLinePattern","ProjectionLineWeight","Transparency"
#Assign your output to the OUT variable.
OUT = list
# ----------------------------------------
python_script_3 = Python(IN[0]=filterByBoolMask.out, IN[1]=ViewList)
# ---------- python_script_3.python (30 lines) ----------
import clr

clr.AddReference('RevitAPI')
from Autodesk.Revit.DB import *

elements = UnwrapElement(IN[0])
view = UnwrapElement(IN[1])

OUT = []
for element in elements:
	o = view.GetElementOverrides(element.Id)
	OUT.append(
	([
	o.CutFillColor.IsValid, 
	o.CutFillPatternId.IntegerValue > 0, 
	o.CutLineColor.IsValid, 
	o.CutLinePatternId.IntegerValue > 0, 
	o.CutLineWeight > 0, 
	o.DetailLevel.ToString() != "Undefined",
	o.Halftone,	
	not(o.IsCutFillPatternVisible),
	not(o.IsProjectionFillPatternVisible), 
	o.ProjectionFillColor.IsValid, 
	o.ProjectionFillPatternId.IntegerValue > 0, 
	o.ProjectionLineColor.IsValid, 
	o.ProjectionLinePatternId.IntegerValue > 0, 
	o.ProjectionLineWeight > 0, 
	o.Transparency != 0
	])
	)
# ----------------------------------------
code_block = CodeBlock { true; }
allIndicesOf = List.AllIndicesOf(list=python_script_3@L2, item=code_block)
getItemAtIndex = List.GetItemAtIndex(list=python_script_2, index=allIndicesOf)
WhatIsOverridden = Output(getItemAtIndex)
