# Dynamo custom node __Find_Floating_Elements.dyf "❄_Find Floating Elements" (Dynamo 2.0.3.8810)
# category: Sastrugi.Elements
# (Sastrugi_Elements) This node checks if Elements have overlapping geometry with other Elements or are floating in 3D virtual space.

Elements = Input(Elements: var[]..[])
flatten = List.Flatten(list=Elements)
geometry = Element.Geometry(element=flatten)
isEmpty = List.IsEmpty(list=geometry@L2)
filterByBoolMask = List.FilterByBoolMask(list=flatten, mask=isEmpty)
filterByBoolMask_2 = List.FilterByBoolMask(list=geometry, mask=isEmpty)
flatten_2 = List.Flatten(list=filterByBoolMask_2.out)
doesIntersect = Geometry.DoesIntersect(geometry=flatten_2, other=flatten_2, lacing=CrossProduct)
countTrue = List.CountTrue(list=doesIntersect@L2, lacing=Longest)
code_block = CodeBlock(x=countTrue)
# ---------- code_block.designscript (3 lines) ----------
x==1 ?
true:
false;
# ----------------------------------------
filterByBoolMask_3 = List.FilterByBoolMask(list=filterByBoolMask.out, mask=code_block)
FloatingElements = Output(filterByBoolMask_3.in)
OverlappingElements = Output(filterByBoolMask_3.out)
