# Dynamo custom node __Fit_Points_by_Coordinate_Systems.dyf "❄_Fit Points by Coordinate Systems" (Dynamo 2.0.3.8810)
# category: Sastrugi.Points
# (Sastrugi_Points) This node finds the best fit of a series of points with another by using average coordinate systems.

ScaleToFit = Input(ScaleToFit: bool = false)
ReferencePoints = Input(ReferencePoints: var[]..[])
flatten = List.Flatten(list=ReferencePoints)
code_block = CodeBlock(ref=flatten) { ref; }
PointsToFit = Input(PointsToFit: var[]..[])
flatten_2 = List.Flatten(list=PointsToFit)
code_block_2 = CodeBlock(move=flatten_2) { move; }
byBestFitThroughPoints = Line.ByBestFitThroughPoints(bestFitPoints=code_block_2)
code_block_3 = CodeBlock { 0.5; }
coordinateSystemAtParameter = Curve.CoordinateSystemAtParameter(curve=byBestFitThroughPoints, param=code_block_3)
byBestFitThroughPoints_2 = Line.ByBestFitThroughPoints(bestFitPoints=code_block)
coordinateSystemAtParameter_2 = Curve.CoordinateSystemAtParameter(curve=byBestFitThroughPoints_2, param=code_block_3)
transform = Geometry.Transform(geometry=code_block_2, fromCoordinateSystem=coordinateSystemAtParameter, contextCoordinateSystem=coordinateSystemAtParameter_2)
distanceTo = Geometry.DistanceTo(geometry=code_block, other=transform, lacing=CrossProduct)
flatten_3 = List.Flatten(list=distanceTo)
average = Math.Average(numbers=flatten_3)
reverse = Curve.Reverse(curve=byBestFitThroughPoints_2)
coordinateSystemAtParameter_3 = Curve.CoordinateSystemAtParameter(curve=reverse, param=code_block_3)
transform_2 = Geometry.Transform(geometry=code_block_2, fromCoordinateSystem=coordinateSystemAtParameter, contextCoordinateSystem=coordinateSystemAtParameter_3)
distanceTo_2 = Geometry.DistanceTo(geometry=transform_2, other=transform, lacing=CrossProduct)
flatten_4 = List.Flatten(list=distanceTo_2)
average_2 = Math.Average(numbers=flatten_4)
code_block_4 = CodeBlock(x=average, y=average_2, a=transform, b=transform_2)
# ---------- code_block_4.designscript (3 lines) ----------
x<=y ?
a:
b;
# ----------------------------------------
XYPlane = CoordinateSystem.XYPlane(coordinateSystem=coordinateSystemAtParameter_2)
XYPlane_2 = CoordinateSystem.XYPlane(coordinateSystem=coordinateSystemAtParameter_3)
code_block_5 = CodeBlock(x=average, y=average_2, a=XYPlane, b=XYPlane_2)  # same code as code_block_4
length = Curve.Length(curve=byBestFitThroughPoints_2)
code_block_6 = CodeBlock { null; }
if_ = If(test=ScaleToFit, true=byBestFitThroughPoints, false=code_block_6)
length_2 = Curve.Length(curve=if_)
code_block_7 = CodeBlock(a=length, b=length_2) { a/b; }
scale = Geometry.Scale(geometry=code_block_4, plane=code_block_5, xamount=code_block_7, yamount=code_block_7, zamount=code_block_7)
if_2 = If(test=ScaleToFit, true=scale, false=code_block_4)
FittedPoints = Output(if_2)
