# Dynamo custom node __Get_Dimension_Overrides.dyf "❄_Get Dimension Overrides" (Dynamo 2.2.1.5175)
# category: Sastrugi.Annotations
# (Sastrugi_Annotations) This node extracts any overridden values within the input Dimensions.

DimensionList = Input(DimensionList: var[]..[])
flatten = List.Flatten(list=DimensionList)
uniqueId = Element.UniqueId(element=flatten)
ElementUniqueID = Output(uniqueId)
create = List.Create(item0=uniqueId)
python_script = Python(IN[0]=flatten)
# ---------- python_script.python (29 lines) ----------
import clr
clr.AddReference('RevitAPI')
from Autodesk.Revit.DB import *

clr.AddReference('RevitServices')
import RevitServices
from RevitServices.Persistence import DocumentManager
from RevitServices.Transactions import TransactionManager

doc = DocumentManager.Instance.CurrentDBDocument

dimensions = UnwrapElement(IN[0])
params = []

TransactionManager.Instance.EnsureInTransaction(doc)
for i in dimensions:
		param1 = i.Prefix
		param2 = i.Above
		param3 = i.ValueOverride
		param4 = i.Below
		param5 = i.Suffix
		params.append(param1)
		params.append(param2)
		params.append(param3)
		params.append(param4)
		params.append(param5)
TransactionManager.Instance.TransactionTaskDone()	

OUT = params
# ----------------------------------------
code_block = CodeBlock { 5; }
chop = List.Chop(list=python_script, lengths=code_block)
transpose = List.Transpose(lists=chop)
join = List.Join(list0=create, list1=transpose)
code_block_2 = CodeBlock { null; }
code_block_3 = CodeBlock { ""; }
eq = _ == code_block_3  # unwired: x
replaceByCondition = Replace(item=join, replaceWith=code_block_2, condition=eq)
code_block_4 = CodeBlock(u=replaceByCondition) { u[1]; u[2]; u[3]; u[4]; u[5]; }
Prefix = Output(code_block_4.out0)
Above = Output(code_block_4.out1)
ValueOverride = Output(code_block_4.out2)
Below = Output(code_block_4.out3)
Suffix = Output(code_block_4.out4)
