# Dynamo custom node __Group_By_Type_Class.dyf "❄_Group By Type Class" (Dynamo 2.2.1.5175)
# category: Sastrugi.Lists
# (Sastrugi_Lists) This node groups elements based on their API Type Class.

InputList = Input(InputList: var[]..[])
flatten = List.Flatten(list=InputList)
python_script = Python(IN[0]=flatten)
# ---------- python_script.python (19 lines) ----------
import clr
clr.AddReference('ProtoGeometry')
from Autodesk.DesignScript.Geometry import *

clr.AddReference('RevitAPI')
from Autodesk.Revit.DB import *

clr.AddReference("RevitNodes")
import Revit
clr.ImportExtensions(Revit.GeometryConversion)

data=IN[0]
result=[]

for d in data:
	p1=str(d.GetType())
	result.append(p1)

OUT = result
# ----------------------------------------
groupByKey = List.GroupByKey(list=flatten, keys=python_script)
Elements = Output(groupByKey.groups)
