# Dynamo custom node __Levenshtein_String_Comparison.dyf "❄_Levenshtein String Comparison" (Dynamo 2.0.3.8810)
# category: Sastrugi.Annotations
# This node compares the minimal number of deletions, insertions, or substitutions that are required to transform strings from a source list into a target string and outputs the best solution.

StringsToCompare = Input(StringsToCompare: var[]..[])
uniqueItems = List.UniqueItems(list=StringsToCompare)
ReferenceString = Input(ReferenceString: var[]..[])
python_script = Python(IN[0]=ReferenceString, IN[1]=uniqueItems)
# ---------- python_script.python (45 lines) ----------
import clr

import System
from System import Array
from System.Collections.Generic import *

import sys
sys.path.append('C:\Program Files (x86)\IronPython 2.7\Lib')
from types import *
	
def levenshtein(seq1, seq2):
    size_x = len(seq1) + 1
    size_y = len(seq2) + 1
    matrix = Array.CreateInstance(int,size_x,size_y)
    for x in xrange(size_x):
        matrix [x, 0] = x
    for y in xrange(size_y):
        matrix [0, y] = y

    for x in xrange(1, size_x):
        for y in xrange(1, size_y):
            if seq1[x-1] == seq2[y-1]:
                matrix [x,y] = min(
                    matrix[x-1, y] + 1,
                    matrix[x-1, y-1],
                    matrix[x, y-1] + 1
                )
            else:
                matrix [x,y] = min(
                    matrix[x-1,y] + 1,
                    matrix[x-1,y-1] + 1,
                    matrix[x,y-1] + 1
                )
    return (matrix[size_x - 1, size_y - 1])

in1 = IN[0]
in2 = IN[1]

ratio = []

for i in in2:
	r = levenshtein(i,in1)
	ratio.append(r)

OUT = ratio
# ----------------------------------------
sortIndexByValue = List.SortIndexByValue(list=python_script)
code_block = CodeBlock(list=uniqueItems, first=sortIndexByValue) { list[first[0]]; }
BestMatch = Output(code_block)
