# Dynamo custom node __Pick_Points_on_Workplane.dyf "❄_Pick Points on Workplane" (Dynamo 2.0.3.8810)
# category: Sastrugi.Selection
# (Sastrugi_Selection) This node allows users to pick points in Revit on the Active Workplane.

code_block = CodeBlock()
# ---------- code_block.designscript (2 lines) ----------
//String Input Req
"Run";
# ----------------------------------------
Reset = Input(Reset: bool = false)
python_script = Python(IN[0]=code_block, IN[1]=Reset)
# ---------- python_script.python (38 lines) ----------
import clr
clr.AddReference('ProtoGeometry')
from Autodesk.DesignScript.Geometry import *

clr.AddReference("RevitAPIUI")
from  Autodesk.Revit.UI import TaskDialog

clr.AddReference('RevitAPI')
from Autodesk.Revit.DB.Events import *

clr.AddReference("RevitServices")
import RevitServices
from RevitServices.Persistence import DocumentManager
doc = DocumentManager.Instance.CurrentDBDocument
uidoc=DocumentManager.Instance.CurrentUIApplication.ActiveUIDocument

x=True
dypoint = []
rpointM = []
rpointI = []
counter=0
msg = 'Pick Points on current Workplane in order, hit ESC when finished.'

TaskDialog.Show("Sastrugi", msg)

while x == True:
	try:
		pt=uidoc.Selection.PickPoint(UnwrapElement(IN[0]))
		rpM=Point.ByCoordinates(pt.X*304.8,pt.Y*304.8,pt.Z*304.8)
		rpI=Point.ByCoordinates(pt.X,pt.Y,pt.Z)
		counter=+1
		dypoint.append(pt)
		rpointM.append(rpM)
		rpointI.append(rpI)
	except:
		x=False

OUT=(dypoint,rpointM,rpointI)
# ----------------------------------------
code_block_2 = CodeBlock(a=python_script) { a[0]; a[1]; a[2]; }
DynamoXYZ = Output(code_block_2.out0)

# group: Adjust for units
python_script_2 = Python(IN[0]=Reset)
# ---------- python_script_2.python (16 lines) ----------
import clr

clr.AddReference('RevitAPI')
from Autodesk.Revit.DB import *

clr.AddReference('RevitServices')
import RevitServices
from RevitServices.Persistence import DocumentManager
from RevitServices.Transactions import TransactionManager

doc = DocumentManager.Instance.CurrentDBDocument

unittype = UnitType.UT_Length
formatoptions = doc.GetUnits().GetFormatOptions(unittype)
dispunits = formatoptions.DisplayUnits
OUT = str(dispunits)
# ----------------------------------------
code_block_3 = CodeBlock()
# ---------- code_block_3.designscript (3 lines) ----------
["Feet",
"Inches"];
true;
# ----------------------------------------
contains = String.Contains(str=python_script_2, searchFor=code_block_3.out0, ignoreCase=code_block_3.out1)
countTrue = List.CountTrue(list=contains)
code_block_4 = CodeBlock(n=countTrue)
# ---------- code_block_4.designscript (3 lines) ----------
n > 0?
1:
0;
# ----------------------------------------

code_block_5 = CodeBlock(switch=code_block_4, metric=code_block_2.out1, imperial=code_block_2.out2)
# ---------- code_block_5.designscript (3 lines) ----------
switch==0?
metric:
imperial;
# ----------------------------------------
RevitPoints = Output(code_block_5)
