# Dynamo custom node __Pointcloud_Get_Graphics_Override_Settings.dyf "❄_Pointcloud Get Graphics Override Settings" (Dynamo 2.2.1.5175)
# category: Sastrugi.Pointcloud.Graphics
# (Sastrugi_Pointcloud_Graphics) Get the current OverrideSettings for a Pointcloud Instance.

PointcloudInstance = Input(PointcloudInstance: var[]..[])
ViewList = Input(ViewList: var[]..[])
python_script = Python(IN[0]=PointcloudInstance, IN[1]=ViewList)
# ---------- python_script.python (29 lines) ----------
# Python coding credit to Dynamo Forum user - @Ewan_Opie 2019
# Sastrugi Package https://sites.google.com/view/sastrugi/home

import clr
clr.AddReference("RevitAPI")
import Autodesk
from Autodesk.Revit.DB import *

def tolist(obj1):
	if hasattr(obj1,"__iter__"): return obj1
	else: return [obj1]	
	
cloud = tolist(UnwrapElement(IN[0]))
views = tolist(UnwrapElement(IN[1]))

pc0a = []

for c in cloud:
	for v in views:
		pc0 = []
		pt_overrides = v.GetPointCloudOverrides()
		pp=pt_overrides.GetPointCloudScanOverrideSettings(c.Id)
		ppMode = pp.ColorMode
		pc0.append(pt_overrides)
		pc0.append(pp)
		pc0.append(ppMode)
	pc0a.append(pc0)
   
OUT = pc0a
# ----------------------------------------
InstanceOverrideSettings = Output(python_script)
python_script_2 = Python(IN[0]=PointcloudInstance, IN[1]=ViewList)
# ---------- python_script_2.python (59 lines) ----------
# Python coding credit to Dynamo Forum user - @Ewan_Opie 2019
# Sastrugi Package https://sites.google.com/view/sastrugi/home

import clr
clr.AddReference("RevitNodes")
import Revit
clr.ImportExtensions(Revit.Elements)

clr.AddReference("RevitServices")
import RevitServices
from RevitServices.Persistence import DocumentManager
from RevitServices.Transactions import TransactionManager

from System.Collections.Generic import *

clr.AddReference("RevitAPI")
import Autodesk
from Autodesk.Revit.DB import *

from Autodesk.Revit import DB

clr.AddReference('DSCoreNodes') 
import DSCore
from DSCore import *

clr.ImportExtensions(Revit.GeometryConversion)

doc = DocumentManager.Instance.CurrentDBDocument
uiapp = DocumentManager.Instance.CurrentUIApplication
app = uiapp.Application

def tolist(obj1):
	if hasattr(obj1,"__iter__"): return obj1
	else: return [obj1]	
	
cloud = tolist(UnwrapElement(IN[0]))
views = tolist(UnwrapElement(IN[1]))

scans = []

for c in cloud:
	scans.append(c.GetScans())

for v in views:
	pc1b = []
	for sca, c in zip(scans,cloud):
			pc1a = []
			for s in sca:
				pc1 = []
				pt_overrides = v.GetPointCloudOverrides()
				pp=pt_overrides.GetPointCloudScanOverrideSettings(c.Id,s,doc)
				ppMode = pp.ColorMode
				pc1.append(pt_overrides)
				pc1.append(pp)
				pc1.append(ppMode)
				pc1a.append(pc1)
			pc1b.append(pc1a)
   
OUT = pc1b
# ----------------------------------------
ScanOverrideSettings = Output(python_script_2)
python_script_3 = Python(IN[0]=PointcloudInstance, IN[1]=ViewList)
# ---------- python_script_3.python (59 lines) ----------
# Python coding credit to Dynamo Forum user - @Ewan_Opie 2019
# Sastrugi Package https://sites.google.com/view/sastrugi/home

import clr
clr.AddReference("RevitNodes")
import Revit
clr.ImportExtensions(Revit.Elements)

clr.AddReference("RevitServices")
import RevitServices
from RevitServices.Persistence import DocumentManager
from RevitServices.Transactions import TransactionManager

from System.Collections.Generic import *

clr.AddReference("RevitAPI")
import Autodesk
from Autodesk.Revit.DB import *

from Autodesk.Revit import DB

clr.AddReference('DSCoreNodes') 
import DSCore
from DSCore import *

clr.ImportExtensions(Revit.GeometryConversion)

doc = DocumentManager.Instance.CurrentDBDocument
uiapp = DocumentManager.Instance.CurrentUIApplication
app = uiapp.Application

def tolist(obj1):
	if hasattr(obj1,"__iter__"): return obj1
	else: return [obj1]	
	
cloud = tolist(UnwrapElement(IN[0]))
views = tolist(UnwrapElement(IN[1]))

regions = []

for c in cloud:
	regions.append(c.GetRegions())

for v in views:
	pc1b = []
	for reg, c in zip(regions,cloud):
			pc1a = []
			for r in reg:
				pc1 = []
				pt_overrides = v.GetPointCloudOverrides()
				pp=pt_overrides.GetPointCloudRegionOverrideSettings(c.Id,r,doc)
				ppMode = pp.ColorMode
				pc1.append(pt_overrides)
				pc1.append(pp)
				pc1.append(ppMode)
				pc1a.append(pc1)
			pc1b.append(pc1a)
   
OUT = pc1b
# ----------------------------------------
RegionOverrideSettings = Output(python_script_3)
