# Dynamo custom node __Pointcloud_Graphics_Override_Settings_By_Intensity.dyf "❄_Pointcloud Graphics Override Settings By Intensity" (Dynamo 2.0.3.8810)
# category: Sastrugi.Pointcloud.Graphics
# (Sastrugi_Pointcloud_Graphics) Override settings for Pointcloud by Intensity.

# group: Fixed Color
python_script = Python()  # unwired: IN[0]
# ---------- python_script.python (34 lines) ----------
# Python coding credit to Dynamo Forum user - @Ewan_Opie 2019
# Sastrugi Package https://sites.google.com/view/sastrugi/home

import clr
clr.AddReference("RevitNodes")
import Revit
clr.ImportExtensions(Revit.Elements)

clr.AddReference("RevitServices")
import RevitServices
from RevitServices.Persistence import DocumentManager
from RevitServices.Transactions import TransactionManager

from System.Collections.Generic import *

clr.AddReference("RevitAPI")
import Autodesk
from Autodesk.Revit.DB import *

from Autodesk.Revit import DB

clr.ImportExtensions(Revit.GeometryConversion)

doc = DocumentManager.Instance.CurrentDBDocument

pts = DB.FilteredElementCollector(doc).OfClass(DB.PointCloudInstance).WhereElementIsNotElementType().ToElements()

pt_cloud_settings = DB.PointClouds.PointCloudOverrideSettings()

pt_cloud_settings.ColorMode = DB.PointCloudColorMode.FixedColor

OUT = pt_cloud_settings.ColorMode

	
# ----------------------------------------
MinColor = Input(MinColor: DSCore.Color = DSCore.Color.ByARGB(255, 0, 0, 0))
MaxColor = Input(MaxColor: DSCore.Color = DSCore.Color.ByARGB(255, 255, 255, 255))
python_script_2 = Python(IN[0]=MinColor, IN[1]=MaxColor)
# ---------- python_script_2.python (44 lines) ----------
# Python coding credit to Dynamo Forum user - @Ewan_Opie 2019
# Sastrugi Package https://sites.google.com/view/sastrugi/home

import clr
clr.AddReference("RevitNodes")
import Revit
clr.ImportExtensions(Revit.Elements)

clr.AddReference("RevitServices")
import RevitServices
from RevitServices.Persistence import DocumentManager
from RevitServices.Transactions import TransactionManager

from System.Collections.Generic import *

clr.AddReference("RevitAPI")
import Autodesk
from Autodesk.Revit.DB import *

from Autodesk.Revit import DB

clr.ImportExtensions(Revit.GeometryConversion)

doc = DocumentManager.Instance.CurrentDBDocument

color1 = IN[0]
color2 = IN[1]

r1 = color1.Red
g1 = color1.Green
b1 = color1.Blue

r2 = color2.Red
g2 = color2.Green
b2 = color2.Blue

c1 = Autodesk.Revit.DB.Color(r1,g1,b1)
c2 = Autodesk.Revit.DB.Color(r2,g2,b2)

pts = DB.FilteredElementCollector(doc).OfClass(DB.PointCloudInstance).WhereElementIsNotElementType().ToElements()

pc_col_set = DB.PointClouds.PointCloudColorSettings(c1,c2)

OUT=pc_col_set
# ----------------------------------------
code_block = CodeBlock(col_mode=python_script, col_settings=python_script_2) { col_mode; col_settings; }
python_script_3 = Python(IN[0]=code_block.col_mode, IN[1]=code_block.col_settings)
# ---------- python_script_3.python (45 lines) ----------
# Python coding credit to Dynamo Forum user - @Ewan_Opie 2019
# Sastrugi Package https://sites.google.com/view/sastrugi/home

import clr
clr.AddReference("RevitNodes")
import Revit
clr.ImportExtensions(Revit.Elements)

clr.AddReference("RevitServices")
import RevitServices
from RevitServices.Persistence import DocumentManager
from RevitServices.Transactions import TransactionManager

from System.Collections.Generic import *

clr.AddReference("RevitAPI")
import Autodesk
from Autodesk.Revit.DB import *

from Autodesk.Revit import DB

clr.ImportExtensions(Revit.GeometryConversion)

doc = DocumentManager.Instance.CurrentDBDocument
uiapp = DocumentManager.Instance.CurrentUIApplication
app = uiapp.Application

def tolist(obj1):
	if hasattr(obj1,"__iter__"): return obj1
	else: return [obj1]	
	
cmode = tolist(IN[0])
csettings = tolist(IN[1])

pcOSsettings = []

pts = DB.FilteredElementCollector(doc).OfClass(DB.PointCloudInstance).WhereElementIsNotElementType().ToElements()

for cm,cs in zip(cmode, csettings):
	pc_os = DB.PointClouds.PointCloudOverrideSettings()
	pc_os.ColorMode = cm
	pc_os.SetModeOverride(cm,cs)
	pcOSsettings.append(pc_os)

OUT = pcOSsettings
# ----------------------------------------
OverrideSettings = Output(python_script_3)
