# Dynamo custom node __Pointcloud_RANSAC_Plane_Detection.dyf "❄_Pointcloud RANSAC Plane Detection" (Dynamo 2.6.1.8786)
# category: Sastrugi.Pointcloud.Geometry
# (Sastrugi_Pointcloud_Geometry) This node uses Random sample consensus (RANSAC) to determine planes within Pointclouds and groups point-sets based on these planes.

# group: Input
InputPoints = Input(InputPoints: var[]..[])
X = Point.X(point=InputPoints)
Y = Point.Y(point=InputPoints)
Z = Point.Z(point=InputPoints)
list_create = List.Create(item0=X, item1=Y, item2=Z)
transpose = List.Transpose(lists=list_create)
code_block = CodeBlock(input_points_list=transpose)
# ---------- code_block.designscript (3 lines) ----------
//Input points list in
//[[x,y,z],[x,y,z]] formated floats.
input_points_list;
# ----------------------------------------
Iterations = Input(Iterations: int = 3)  # The number of times a random selection of 3-points is made to find planes that best fit point-sets.
Threshold = Input(Threshold: var = 0.05)  # The threshold for distance deviation from the 3-point plane equation to use to group planar points.

code_block_2 = CodeBlock(pts_coords=code_block)
# ---------- code_block_2.designscript (2 lines) ----------
//Required unit conversion
pts_coords/1000;
# ----------------------------------------

# group: RANSAC 3D Plane Detection - IronPython
py_ransac = Python(IN[0]=code_block_2, IN[1]=Iterations, IN[2]=Threshold)
# ---------- py_ransac.python (173 lines) ----------
# Python coding credit to Dynamo Forum user - @Ewan_Opie 2021
# Sastrugi Package https://sites.google.com/view/sastrugi/home

###IronPython2 code ###

# Imports
import random
import clr
import math

clr.AddReference('ProtoGeometry')
from Autodesk.DesignScript.Geometry import *
   
## Remove item at index
def rem(l, id_to_del):
    somelist = [i for j, i in enumerate(l) if j not in id_to_del]
    return somelist    
    
## Perform cross product for vector lists
def cross_product(a, b):
    c = [a[1]*b[2] - a[2]*b[1],
         a[2]*b[0] - a[0]*b[2],
         a[0]*b[1] - a[1]*b[0]]

    return c

## Convert an instance/list to a list
def tolist(obj1):
	if hasattr(obj1,"__iter__"): return obj1
	else: return [obj1]

## Calc normal vector for sample points
def linear_alg_norm(vec):
    return math.sqrt((vec*vec))

# Find the distance of points to the plane equation
def dist_calc(plane_eq,p):
    try:
        dc = (plane_eq[0] * p[0] + plane_eq[1] * p[1] + plane_eq[2] * p[2] + plane_eq[3]) / math.sqrt(plane_eq[0] ** 2 + plane_eq[1] ** 2 + plane_eq[2] ** 2)
    except:
        dc = 1
    return dc

class RANSAC_3D_Planes:
    """
    This implementation of Random sample consensus (RANSAC) is an iterative method to estimate planes from 3D pointcloud data.
    """

    def __init__(self):
        self.inliers = []
        self.equation = []
        self.testing = []

    def fit_plane(self, pts, thresh, minPoints=100, maxIter=1000):
        """
        Find the best plane.
        
        Inputs:
        pts = 3D point cloud as a `np.array (N,3)`.
        thresh = Threshold distance from the plane which is considered inlier.
        maxIter = Number of maximum iteration which RANSAC will loop over.
         """
        #n_points = pts.shape[0]
        n_points = len(pts)
        best_eq = []
        best_inliers = []

        for it in range(maxIter):

            # Samples 3 random points
            id_samples = random.sample(range(0, n_points), 3)
            pt_samples = []
            for x in id_samples: 
                pt_samples.append(pts[x])

            # Find the plane equation described by those 3 points
            # We find first 2 vectors that are part of this plane
            # A = pt2 - pt1
            # B = pt3 - pt1

            vecA1 = pt_samples[1][0] - pt_samples[0][0]
            vecA2 = pt_samples[1][1] - pt_samples[0][1]
            vecA3 = pt_samples[1][2] - pt_samples[0][2]
            vecA = [vecA1,vecA2,vecA3]
            
            vecB1 = pt_samples[2][0] - pt_samples[0][0]
            vecB2 = pt_samples[2][1] - pt_samples[0][1]
            vecB3 = pt_samples[1][2] - pt_samples[0][2]
            vecB = [vecB1,vecB2,vecB3]

            # Compute the cross product of vecA and vecB to get vecC which is normal to the plane
            vecC = cross_product(vecA,vecB)
                                        
            # The plane equation will be vecC[0]*x + vecC[1]*y + vecC[0]*z = -k
            # We have to use a point to find k
            norm = []

            for v in vecC:
               if v < 0:
                   norm.append(linear_alg_norm(v)*-1)
               else:
                   norm.append(linear_alg_norm(v))

            k1 = norm[0] * pt_samples[1][0]
            k2 = norm[1] * pt_samples[1][1]
            k3 = norm[2] * pt_samples[1][2]
            k4 = k1+k2+k3
            k = -k4

            plane_eq = [norm[0], norm[1], norm[2], k]
            
            # Distance from a point to a plane
            pt_id_inliers = [] 
            dist_pt = []
            for p in pts:
                d = abs(dist_calc(plane_eq,p))
                if d <= thresh:
                    pt_id_inliers.append(pts.index(p))
                
            # Found plane pts meet requirements
            if len(pt_id_inliers) > len(best_inliers):
                best_eq = plane_eq
                best_inliers = pt_id_inliers
            self.inliers = best_inliers
            self.equation = best_eq

        return self.inliers

## Inputs

# Input points list in [[x,y,z],[x,y,z]] formated floats.
points = IN[0]

# The number of planes to attempt to find
max_iter = IN[1]

# Plane point threshold
thresh1 = IN[2]

## Outputs 
result = []

# Main Loop
for m in range(max_iter):  
    points_list = []
        
    pts_found = 0
    # Find best planes
    ransac = RANSAC_3D_Planes()
    best_inliers = ransac.fit_plane(points,thresh1)

    plane_pts = []
        
    # Remove plane pts from point list
    del points_list[:]
    remaining_pts = rem(points,best_inliers)    
        
    # Create Points from array pts
    for b in best_inliers:
        item = points[b]
        pts_found = + 1
        pt = Point.ByCoordinates(item[0],item[1],item[2])
        #pt = Point.ByCoordinates(b[0],b[1],b[2])
            
        plane_pts.append(pt)
        
    # Reset points list with plane_pts removed
    points = remaining_pts
       
    # Add plane pts to output
    result.append(plane_pts)
        
OUT = result
# ----------------------------------------

# group: Rescale Points
code_block_3 = CodeBlock(p=py_ransac) { p.X*1000; p.Y*1000; p.Z*1000; }
byCoordinates = Point.ByCoordinates(x=code_block_3.out0, y=code_block_3.out1, z=code_block_3.out2)

# group: Output
byBestFitThroughPoints = Plane.ByBestFitThroughPoints(points=byCoordinates)
Planes = Output(byBestFitThroughPoints)
PointSets = Output(byCoordinates)
