# Dynamo custom node __Pointcloud_Reset_Graphics_Override.dyf "❄_Pointcloud Reset Graphics Override" (Dynamo 2.2.1.5175)
# category: Sastrugi.Pointcloud.Graphics
# (Sastrugi-Pointcloud_Graphics) Removes all Graphics overrides from Pointcloud Instances and their embeded Scans / Regions.

PointcloudInstances = Input(PointcloudInstances: var[]..[])
ViewList = Input(ViewList: var[]..[])
python_script = Python(IN[0]=PointcloudInstances, IN[1]=ViewList)
# ---------- python_script.python (78 lines) ----------
# Python coding credit to Dynamo Forum user - @Ewan_Opie 2019
# Sastrugi Package https://sites.google.com/view/sastrugi/home

import clr
clr.AddReference("RevitNodes")
import Revit
clr.ImportExtensions(Revit.Elements)

clr.AddReference("RevitServices")
import RevitServices
from RevitServices.Persistence import DocumentManager
from RevitServices.Transactions import TransactionManager

from System.Collections.Generic import *

clr.AddReference("RevitAPI")
import Autodesk
from Autodesk.Revit.DB import *

from Autodesk.Revit import DB

clr.AddReference('DSCoreNodes') 
import DSCore
from DSCore import *

import sys
pyt_path = r'C:\Program Files (x86)\IronPython 2.7\Lib'
sys.path.append(pyt_path)

clr.ImportExtensions(Revit.GeometryConversion)

doc = DocumentManager.Instance.CurrentDBDocument
uiapp = DocumentManager.Instance.CurrentUIApplication
app = uiapp.Application

def tolist(obj1):
	if hasattr(obj1,"__iter__"): return obj1
	else: return [obj1]	
	
cloud = tolist(UnwrapElement(IN[0]))

views = tolist(UnwrapElement(IN[1]))

pcOSsettings = []
regions = []
scans = []

pc_os = DB.PointClouds.PointCloudOverrideSettings()
pc_os.ColorMode = DB.PointCloudColorMode.NoOverride

TransactionManager.Instance.EnsureInTransaction(doc)

try:
		errorReport = None
		for c in cloud:
			scans.append(c.GetScans())
			regions.append(c.GetRegions())
			scanNames = DSCore.List.Flatten(scans,1)
			regionNames = DSCore.List.Flatten(regions,1)
			for v in views:
				pt_overrides = v.GetPointCloudOverrides()
				pt_overrides.SetPointCloudScanOverrideSettings(c.Id, pc_os)
			for s in scanNames:
				pt_overrides.SetPointCloudScanOverrideSettings(c.Id, pc_os,s,doc)
			for r in regionNames:
				pt_overrides.SetPointCloudScanOverrideSettings(c.Id, pcOSsettings,r,doc)
except:
		import traceback
		errorReport = str(traceback.format_exc())
		
TransactionManager.Instance.TransactionTaskDone()

if errorReport == None:
	OUT = cloud
else:
	OUT = errorReport

	
# ----------------------------------------
PointcloudInstances_2 = Output(python_script)  # "PointcloudInstances"
