# Dynamo custom node __Pointcloud_Select_Points.dyf "❄_Pointcloud Select Points" (Dynamo 2.10.1.3976)
# category: Sastrugi.Pointcloud.Geometry
# (Sastrugi_Pointcloud_Geometry) This node allows the selection of a multiple points from a Pointcloud Instance.

Refresh = Input(Refresh: bool = true)
code_block = CodeBlock()
# ---------- code_block.designscript (2 lines) ----------
//Initial Ray
100;
# ----------------------------------------
py_pickpoint_bbox = Python(IN[0]=Refresh, IN[1]=code_block)  # IronPython2
# ---------- py_pickpoint_bbox.python (75 lines) ----------
# Python coding credit to Dynamo Forum user - @Ewan_Opie 2021
# Sastrugi Package https://sites.google.com/view/sastrugi/home

import clr
import sys

clr.AddReference('RevitAPIUI')
from Autodesk.Revit.UI import *
from  Autodesk.Revit.UI import TaskDialog

clr.AddReference('RevitServices')
import RevitServices
from RevitServices.Persistence import DocumentManager

doc = DocumentManager.Instance.CurrentDBDocument
uiapp = DocumentManager.Instance.CurrentUIApplication
app = uiapp.Application
uidoc=DocumentManager.Instance.CurrentUIApplication.ActiveUIDocument

clr.AddReference('RevitNodes')

import System
from System import Array
from System.Collections.Generic import *

import Revit
clr.ImportExtensions(Revit.Elements)
clr.ImportExtensions(Revit.GeometryConversion)

clr.AddReference('RevitAPI')
import Autodesk
from Autodesk.Revit.DB import *
from Autodesk.Revit.DB.PointClouds import *

clr.AddReference('ProtoGeometry')
from Autodesk.DesignScript.Geometry import *
result = []

msg = 'Pick a PointCloudInstance, then the points required.'

TaskDialog.Show("Sastrugi", msg)

sel1 = uidoc.Selection
ot1 = Selection.ObjectType.Element
ot2 = Selection.ObjectType.PointOnElement
li_ref = sel1.PickObject(ot1, 'Select Link')

link1 = doc.GetElement(li_ref.ElementId)
tf1 = link1.GetTotalTransform()
face_ref = sel1.PickObjects(ot2, 'Select Point')

boxSize = IN[1]
offset_dist = 100000


sol_result = []
link1_result = []
viewLine2_result = []

for f in face_ref:
	basePt = f.GlobalPoint.ToPoint(True)
	
	viewDir = doc.ActiveView.ViewDirection.ToVector()
	viewPlane = Plane.ByOriginNormal(basePt,viewDir)
	viewLine1 = Line.ByStartPointDirectionLength(basePt,viewDir,offset_dist*-1)
	viewLine2 = Line.ExtendStart(viewLine1,offset_dist)
	Rect = Rectangle.ByWidthLength(viewPlane,boxSize,boxSize)
	r1 = Geometry.Translate(Rect,Vector.Reverse(viewDir),offset_dist)
	r2 = Geometry.Translate(Rect,viewDir,offset_dist)
	sol = Solid.ByLoft([r1,r2])
	sol_result.append(sol)
	link1_result.append(link1)
	viewLine2_result.append(viewLine2)

OUT = sol_result,link1_result,viewLine2_result
# ----------------------------------------
code_block_2 = CodeBlock(outSolid=py_pickpoint_bbox, outCloud=py_pickpoint_bbox, outViewLine=py_pickpoint_bbox) { outSolid[0]; outCloud[1]; outViewLine[2]; }
code_block_3 = CodeBlock(input_solid=code_block_2.out0) { input_solid; }
centroid = Solid.Centroid(solid=code_block_3)
ZAxis = Vector.ZAxis()
byOriginNormal = Plane.ByOriginNormal(origin=centroid, normal=ZAxis)
code_block_4 = CodeBlock { 1.01; }
scale = Geometry.Scale(geometry=code_block_3, plane=byOriginNormal, xamount=code_block_4, yamount=code_block_4, zamount=code_block_4)
faces = Topology.Faces(topology=scale)
vertices = Face.Vertices(face=faces)
pointGeometry = Vertex.PointGeometry(vertex=vertices)
byBestFitThroughPoints = Plane.ByBestFitThroughPoints(points=pointGeometry)
origin = Plane.Origin(plane=byBestFitThroughPoints)
centroid_2 = Solid.Centroid(solid=code_block_3)
byTwoPoints = Vector.ByTwoPoints(start=origin, end=centroid_2, lacing=Longest)
byOriginNormal_2 = Plane.ByOriginNormal(origin=origin, normal=byTwoPoints)
py_pc_filter = Python(IN[0]=code_block_2.out1, IN[1]=byOriginNormal_2)  # IronPython2
# ---------- py_pc_filter.python (54 lines) ----------
# Python coding credit to Dynamo Forum user - @Ewan_Opie 2021
# Sastrugi Package https://sites.google.com/view/sastrugi/home

import clr
clr.AddReference('ProtoGeometry')
from Autodesk.DesignScript.Geometry import *

clr.AddReference("RevitNodes")
import Revit
clr.ImportExtensions(Revit.Elements)

clr.ImportExtensions(Revit.GeometryConversion)

clr.AddReference("RevitServices")
import RevitServices
from RevitServices.Persistence import DocumentManager
from RevitServices.Transactions import TransactionManager
from System.Collections.Generic import *

clr.AddReference("RevitAPI")
import Autodesk
from Autodesk.Revit.DB import *
from Autodesk.Revit.DB.PointClouds import *

doc = DocumentManager.Instance.CurrentDBDocument
uiapp = DocumentManager.Instance.CurrentUIApplication
app = uiapp.Application
uidoc=DocumentManager.Instance.CurrentUIApplication.ActiveUIDocument
PL_filters = []
for pi in IN[1]:
	PL=[]
	for i in pi:
		PL.append(UnwrapElement(i).ToPlane())
	
	
	IPL=List[Autodesk.Revit.DB.Plane](PL)

	PLfilter=PointCloudFilterFactory.CreateMultiPlaneFilter(PL)
	PL_filters.append(PLfilter)

dist = 0.001
sample= 5
result = []

for pf,pts in zip(PL_filters,UnwrapElement(IN[0])):
	points = pts.GetPoints(pf, dist, sample)
	pointsample=[]
	for p in points:
		X=p.X
		Y=p.Y
		Z=p.Z
		pointsample.append(Point.Create(XYZ(X,Y,Z)).ToProtoType(True))
	result.append(pointsample)
OUT = result
# ----------------------------------------
elementType = Element.ElementType(element=code_block_2.out1)
code_block_5 = CodeBlock { "Scale"; }
getParameterValueByName = Element.GetParameterValueByName(element=elementType, parameterName=code_block_5)
scale_2 = Geometry.Scale(geometry=py_pc_filter, xamount=getParameterValueByName, yamount=getParameterValueByName, zamount=getParameterValueByName)
identity = CoordinateSystem.Identity()
flatten = List.Flatten(list=code_block_2.out1)
python_script = Python(IN[0]=flatten)  # IronPython2
# ---------- python_script.python (48 lines) ----------
# Python coding credit to Dynamo Forum user - @Ewan_Opie 2021
# Sastrugi Package https://sites.google.com/view/sastrugi/home

#BIG THANKS TO @AWILLIAMS
import clr
clr.AddReference('ProtoGeometry')
from Autodesk.DesignScript.Geometry import *

clr.AddReference("RevitNodes")
import Revit
clr.ImportExtensions(Revit.Elements)

clr.AddReference("RevitServices")
import RevitServices
from RevitServices.Persistence import DocumentManager
from RevitServices.Transactions import TransactionManager

from System.Collections.Generic import *

clr.AddReference("RevitAPI")
import Autodesk
from Autodesk.Revit.DB import *

clr.ImportExtensions(Revit.GeometryConversion)

doc = DocumentManager.Instance.CurrentDBDocument
uiapp = DocumentManager.Instance.CurrentUIApplication
app = uiapp.Application


cloud = UnwrapElement(IN[0])

TransactionManager.Instance.EnsureInTransaction(doc)


cloudtransform = []

for c in cloud:
	transform = c.GetTotalTransform()
	X = transform.Origin.X
	Y = transform.Origin.Y
	Z = transform.Origin.Z
	point=Point.Create(XYZ(X,Y,Z)).ToProtoType(True)
	cloudtransform.append(point)
	
TransactionManager.Instance.TransactionTaskDone()

OUT = cloudtransform
# ----------------------------------------
ZAxis_2 = Vector.ZAxis()
byOriginNormal_3 = Plane.ByOriginNormal(origin=python_script, normal=ZAxis_2)
byPlane = CoordinateSystem.ByPlane(plane=byOriginNormal_3)
transform = Geometry.Transform(geometry=scale_2, fromCoordinateSystem=identity, contextCoordinateSystem=byPlane, lacing=Longest)
closestPointTo = Geometry.ClosestPointTo(geometry=code_block_2.out2, other=transform, lacing=Longest)
distanceTo = Geometry.DistanceTo(geometry=transform, other=closestPointTo, lacing=Longest)
minimumItem = List.MinimumItem(list=distanceTo@L2)
indexOf = List.IndexOf(list=distanceTo@L2, element=minimumItem@L1)
getItemAtIndex = List.GetItemAtIndex(list=transform@L2, index=indexOf@L1)
code_block_6 = CodeBlock(localpoints=getItemAtIndex) { localpoints; }
Points = Output(code_block_6)
