# Dynamo custom node __Pointcloud_Select_Points_By_Intersecting_Element.dyf "❄_Pointcloud Select Points By Intersecting Element" (Dynamo 2.10.1.3976)
# category: Sastrugi.Pointcloud.Geometry
# (Sastrugi_Pointcloud_Geometry) This node takes a sample of random points from a Pointcloud Instance by using an intersecting element as the filter.

Refresh = Input(Refresh: bool = true)
py_user_selection = Python(IN[0]=Refresh)  # IronPython2
# ---------- py_user_selection.python (43 lines) ----------
# Python coding credit to Dynamo Forum user - @Ewan_Opie 2021
# Sastrugi Package https://sites.google.com/view/sastrugi/home

import clr

clr.AddReference("RevitAPIUI")
from  Autodesk.Revit.UI import *

clr.AddReference("RevitServices")
import RevitServices
from RevitServices.Persistence import DocumentManager
doc = DocumentManager.Instance.CurrentDBDocument
uidoc=DocumentManager.Instance.CurrentUIApplication.ActiveUIDocument

clr.AddReference("RevitNodes")
import Revit
clr.ImportExtensions(Revit.Elements)

def flatten(*args):
    for x in args:
        if hasattr(x, '__iter__'):
            for y in flatten(*x):
                yield y
        else:
            yield x

sel1 = uidoc.Selection
ot1 = Selection.ObjectType.Element
msg = 'Pick PointCloud in Active View.'
TaskDialog.Show("Sastrugi", msg)
el_refs = sel1.PickObject(ot1, "Select")
typelist = list()
idlist = list()
el_ref = flatten(el_refs)
for i in el_ref:

	try:
		typelist.append(doc.GetElement(i.ElementId))
	except:
		typelist.apped(list())
		

OUT = typelist[-1]
# ----------------------------------------
flatten = List.Flatten(list=py_user_selection)
firstItem = List.FirstItem(list=flatten)
FilterElement = Input(FilterElement: var[]..[])  # Any Revit element that intersects the Pointcloud.
solids = Element.Solids(element=FilterElement)
byUnion = Solid.ByUnion(solids=solids)
faces = Element.Faces(element=FilterElement)
byJoinedSurfaces = Solid.ByJoinedSurfaces(facesOfSolid=faces)
py_solid_switch = Python(IN[0]=byUnion, IN[1]=byJoinedSurfaces)  # IronPython2
# ---------- py_solid_switch.python (9 lines) ----------
s1 = IN[0]
s2 = IN[1]

if s1 == []:
	OUT = s2
elif s1 == None:
	OUT = s2
else:
	OUT = s1
# ----------------------------------------
centroid = Solid.Centroid(solid=py_solid_switch)
ZAxis = Vector.ZAxis()
byOriginNormal = Plane.ByOriginNormal(origin=centroid, normal=ZAxis)
code_block = CodeBlock { 1.01; }
scale = Geometry.Scale(geometry=py_solid_switch, plane=byOriginNormal, xamount=code_block, yamount=code_block, zamount=code_block)
faces_2 = Topology.Faces(topology=scale)
vertices = Face.Vertices(face=faces_2)
pointGeometry = Vertex.PointGeometry(vertex=vertices)
byBestFitThroughPoints = Plane.ByBestFitThroughPoints(points=pointGeometry)
origin = Plane.Origin(plane=byBestFitThroughPoints)
byTwoPoints = Vector.ByTwoPoints(start=origin, end=centroid, lacing=Longest)
byOriginNormal_2 = Plane.ByOriginNormal(origin=origin, normal=byTwoPoints)
code_block_2 = CodeBlock { 0.001; }
PointSampleSize = Input(PointSampleSize: int = 1000)  # This is the number of points to take from within the Pointcloud.
py_pc_filter = Python(IN[0]=firstItem, IN[1]=byOriginNormal_2, IN[2]=code_block_2, IN[3]=PointSampleSize)  # IronPython2
# ---------- py_pc_filter.python (48 lines) ----------
# Python coding credit to Dynamo Forum user - @Ewan_Opie 2021
# Sastrugi Package https://sites.google.com/view/sastrugi/home

import clr
clr.AddReference('ProtoGeometry')
from Autodesk.DesignScript.Geometry import *

clr.AddReference("RevitNodes")
import Revit
clr.ImportExtensions(Revit.Elements)

clr.ImportExtensions(Revit.GeometryConversion)

clr.AddReference("RevitServices")
import RevitServices
from RevitServices.Persistence import DocumentManager
from RevitServices.Transactions import TransactionManager
from System.Collections.Generic import *

clr.AddReference("RevitAPI")
import Autodesk
from Autodesk.Revit.DB import *
from Autodesk.Revit.DB.PointClouds import *

doc = DocumentManager.Instance.CurrentDBDocument
uiapp = DocumentManager.Instance.CurrentUIApplication
app = uiapp.Application
uidoc=DocumentManager.Instance.CurrentUIApplication.ActiveUIDocument

PL=[]
for i in IN[1]:
	PL.append(UnwrapElement(i).ToPlane())

IPL=List[Autodesk.Revit.DB.Plane](PL)
PLfilter=PointCloudFilterFactory.CreateMultiPlaneFilter(PL)

dist = IN[2]
sample= IN[3]

points = UnwrapElement(IN[0]).GetPoints(PLfilter, dist, sample)
pointsample=[]
for p in points:
	X=p.X
	Y=p.Y
	Z=p.Z
	pointsample.append(Point.Create(XYZ(X,Y,Z)).ToProtoType(True))

OUT = pointsample
# ----------------------------------------
flatten_2 = List.Flatten(list=py_pc_filter)
elementType = Element.ElementType(element=py_user_selection)
code_block_3 = CodeBlock { "Scale"; }
getParameterValueByName = Element.GetParameterValueByName(element=elementType, parameterName=code_block_3)
scale_2 = Geometry.Scale(geometry=flatten_2, xamount=getParameterValueByName, yamount=getParameterValueByName, zamount=getParameterValueByName)
identity = CoordinateSystem.Identity()
python_script = Python(IN[0]=flatten)  # IronPython2
# ---------- python_script.python (48 lines) ----------
# Python coding credit to Dynamo Forum user - @Ewan_Opie 2021
# Sastrugi Package https://sites.google.com/view/sastrugi/home

#BIG THANKS TO @AWILLIAMS
import clr
clr.AddReference('ProtoGeometry')
from Autodesk.DesignScript.Geometry import *

clr.AddReference("RevitNodes")
import Revit
clr.ImportExtensions(Revit.Elements)

clr.AddReference("RevitServices")
import RevitServices
from RevitServices.Persistence import DocumentManager
from RevitServices.Transactions import TransactionManager

from System.Collections.Generic import *

clr.AddReference("RevitAPI")
import Autodesk
from Autodesk.Revit.DB import *

clr.ImportExtensions(Revit.GeometryConversion)

doc = DocumentManager.Instance.CurrentDBDocument
uiapp = DocumentManager.Instance.CurrentUIApplication
app = uiapp.Application


cloud = UnwrapElement(IN[0])

TransactionManager.Instance.EnsureInTransaction(doc)


cloudtransform = []

for c in cloud:
	transform = c.GetTotalTransform()
	X = transform.Origin.X
	Y = transform.Origin.Y
	Z = transform.Origin.Z
	point=Point.Create(XYZ(X,Y,Z)).ToProtoType(True)
	cloudtransform.append(point)
	
TransactionManager.Instance.TransactionTaskDone()

OUT = cloudtransform
# ----------------------------------------
ZAxis_2 = Vector.ZAxis()
byOriginNormal_3 = Plane.ByOriginNormal(origin=python_script, normal=ZAxis_2)
byPlane = CoordinateSystem.ByPlane(plane=byOriginNormal_3)
transform = Geometry.Transform(geometry=scale_2, fromCoordinateSystem=identity, contextCoordinateSystem=byPlane, lacing=Longest)
flatten_3 = List.Flatten(list=transform)
Points = Output(flatten_3)
