# Dynamo custom node __Pointcloud_Select_Points_By_Local_Sample.dyf "❄_Pointcloud Select Points By Local Sample" (Dynamo 2.6.1.8786)
# category: Sastrugi.Pointcloud.Geometry
# (Sastrugi_Pointcloud_Geometry) This node allows users to select a specific number of Pointcloud Points by selecting a location on the Pointcloud in the Active View, creating a local sample area to extract points.

Refresh = Input(Refresh: bool = true)
code_block = CodeBlock()
# ---------- code_block.designscript (2 lines) ----------
//Initial Ray
250;
# ----------------------------------------
py_pickpoint_bbox = Python(IN[0]=Refresh, IN[1]=code_block)
# ---------- py_pickpoint_bbox.python (65 lines) ----------
# Python coding credit to Dynamo Forum user - @Ewan_Opie 2021
# Sastrugi Package https://sites.google.com/view/sastrugi/home

import clr
import sys

clr.AddReference('RevitAPIUI')
from Autodesk.Revit.UI import *
from  Autodesk.Revit.UI import TaskDialog

clr.AddReference('RevitServices')
import RevitServices
from RevitServices.Persistence import DocumentManager

doc = DocumentManager.Instance.CurrentDBDocument
uiapp = DocumentManager.Instance.CurrentUIApplication
app = uiapp.Application
uidoc=DocumentManager.Instance.CurrentUIApplication.ActiveUIDocument

clr.AddReference('RevitNodes')

import System
from System import Array
from System.Collections.Generic import *

import Revit
clr.ImportExtensions(Revit.Elements)
clr.ImportExtensions(Revit.GeometryConversion)

clr.AddReference('RevitAPI')
import Autodesk
from Autodesk.Revit.DB import *
from Autodesk.Revit.DB.PointClouds import *

clr.AddReference('ProtoGeometry')
from Autodesk.DesignScript.Geometry import *
result = []

msg = 'Pick a PointCloudInstance, then a sample point.'

TaskDialog.Show("Sastrugi", msg)

sel1 = uidoc.Selection
ot1 = Selection.ObjectType.Element
ot2 = Selection.ObjectType.PointOnElement
li_ref = sel1.PickObject(ot1, 'Select Link')

link1 = doc.GetElement(li_ref.ElementId)
tf1 = link1.GetTotalTransform()
face_ref = sel1.PickObject(ot2, 'Select Point')

basePt = face_ref.GlobalPoint.ToPoint(True)

boxSize = IN[1]

offset_dist = 100000
viewDir = doc.ActiveView.ViewDirection.ToVector()
viewPlane = Plane.ByOriginNormal(basePt,viewDir)
viewLine1 = Line.ByStartPointDirectionLength(basePt,viewDir,offset_dist*-1)
viewLine2 = Line.ExtendStart(viewLine1,offset_dist)
Rect = Rectangle.ByWidthLength(viewPlane,boxSize,boxSize)
r1 = Geometry.Translate(Rect,Vector.Reverse(viewDir),offset_dist)
r2 = Geometry.Translate(Rect,viewDir,offset_dist)
sol = Solid.ByLoft([r1,r2])
OUT = sol,link1,viewLine2
# ----------------------------------------
code_block_2 = CodeBlock(outSolid=py_pickpoint_bbox, outCloud=py_pickpoint_bbox, outViewLine=py_pickpoint_bbox) { outSolid[0]; outCloud[1]; outViewLine[2]; }
code_block_3 = CodeBlock(input_solid=code_block_2.out0) { input_solid; }
centroid = Solid.Centroid(solid=code_block_3)
ZAxis = Vector.ZAxis()
byOriginNormal = Plane.ByOriginNormal(origin=centroid, normal=ZAxis)
code_block_4 = CodeBlock { 1.01; }
scale = Geometry.Scale(geometry=code_block_3, plane=byOriginNormal, xamount=code_block_4, yamount=code_block_4, zamount=code_block_4)
faces = Topology.Faces(topology=scale)
vertices = Face.Vertices(face=faces)
pointGeometry = Vertex.PointGeometry(vertex=vertices)
byBestFitThroughPoints = Plane.ByBestFitThroughPoints(points=pointGeometry)
origin = Plane.Origin(plane=byBestFitThroughPoints)
centroid_2 = Solid.Centroid(solid=code_block_3)
byTwoPoints = Vector.ByTwoPoints(start=origin, end=centroid_2, lacing=Longest)
byOriginNormal_2 = Plane.ByOriginNormal(origin=origin, normal=byTwoPoints)
py_pc_filter = Python(IN[0]=code_block_2.out1, IN[1]=byOriginNormal_2)
# ---------- py_pc_filter.python (49 lines) ----------
# Python coding credit to Dynamo Forum user - @Ewan_Opie 2021
# Sastrugi Package https://sites.google.com/view/sastrugi/home

import clr
clr.AddReference('ProtoGeometry')
from Autodesk.DesignScript.Geometry import *

clr.AddReference("RevitNodes")
import Revit
clr.ImportExtensions(Revit.Elements)

clr.ImportExtensions(Revit.GeometryConversion)

clr.AddReference("RevitServices")
import RevitServices
from RevitServices.Persistence import DocumentManager
from RevitServices.Transactions import TransactionManager
from System.Collections.Generic import *

clr.AddReference("RevitAPI")
import Autodesk
from Autodesk.Revit.DB import *
from Autodesk.Revit.DB.PointClouds import *

doc = DocumentManager.Instance.CurrentDBDocument
uiapp = DocumentManager.Instance.CurrentUIApplication
app = uiapp.Application
uidoc=DocumentManager.Instance.CurrentUIApplication.ActiveUIDocument

PL=[]
for i in IN[1]:
	PL.append(UnwrapElement(i).ToPlane())

IPL=List[Autodesk.Revit.DB.Plane](PL)

PLfilter=PointCloudFilterFactory.CreateMultiPlaneFilter(PL)

dist = 0.001
sample= 5

points = UnwrapElement(IN[0]).GetPoints(PLfilter, dist, sample)
pointsample=[]
for p in points:
	X=p.X
	Y=p.Y
	Z=p.Z
	pointsample.append(Point.Create(XYZ(X,Y,Z)).ToProtoType(True))

OUT = pointsample
# ----------------------------------------
flatten = List.Flatten(list=py_pc_filter)
elementType = Element.ElementType(element=code_block_2.out1)
code_block_5 = CodeBlock { "Scale"; }
getParameterValueByName = Element.GetParameterValueByName(element=elementType, parameterName=code_block_5)
scale_2 = Geometry.Scale(geometry=flatten, xamount=getParameterValueByName, yamount=getParameterValueByName, zamount=getParameterValueByName)
identity = CoordinateSystem.Identity()
flatten_2 = List.Flatten(list=code_block_2.out1)
python_script = Python(IN[0]=flatten_2)
# ---------- python_script.python (48 lines) ----------
# Python coding credit to Dynamo Forum user - @Ewan_Opie 2021
# Sastrugi Package https://sites.google.com/view/sastrugi/home

#BIG THANKS TO @AWILLIAMS
import clr
clr.AddReference('ProtoGeometry')
from Autodesk.DesignScript.Geometry import *

clr.AddReference("RevitNodes")
import Revit
clr.ImportExtensions(Revit.Elements)

clr.AddReference("RevitServices")
import RevitServices
from RevitServices.Persistence import DocumentManager
from RevitServices.Transactions import TransactionManager

from System.Collections.Generic import *

clr.AddReference("RevitAPI")
import Autodesk
from Autodesk.Revit.DB import *

clr.ImportExtensions(Revit.GeometryConversion)

doc = DocumentManager.Instance.CurrentDBDocument
uiapp = DocumentManager.Instance.CurrentUIApplication
app = uiapp.Application


cloud = UnwrapElement(IN[0])

TransactionManager.Instance.EnsureInTransaction(doc)


cloudtransform = []

for c in cloud:
	transform = c.GetTotalTransform()
	X = transform.Origin.X
	Y = transform.Origin.Y
	Z = transform.Origin.Z
	point=Point.Create(XYZ(X,Y,Z)).ToProtoType(True)
	cloudtransform.append(point)
	
TransactionManager.Instance.TransactionTaskDone()

OUT = cloudtransform
# ----------------------------------------
ZAxis_2 = Vector.ZAxis()
byOriginNormal_3 = Plane.ByOriginNormal(origin=python_script, normal=ZAxis_2)
byPlane = CoordinateSystem.ByPlane(plane=byOriginNormal_3)
transform = Geometry.Transform(geometry=scale_2, fromCoordinateSystem=identity, contextCoordinateSystem=byPlane, lacing=Longest)
flatten_3 = List.Flatten(list=transform)
code_block_6 = CodeBlock(InputPoints=flatten_3) { InputPoints; }
closestPointTo = Geometry.ClosestPointTo(geometry=code_block_2.out2, other=code_block_6, lacing=Longest)
distanceTo = Geometry.DistanceTo(geometry=code_block_6, other=closestPointTo, lacing=Longest)
minimumItem = List.MinimumItem(list=distanceTo)
indexOf = List.IndexOf(list=distanceTo, element=minimumItem)
getItemAtIndex = List.GetItemAtIndex(list=code_block_6, index=indexOf)
code_block_7 = CodeBlock(localpoint=getItemAtIndex) { localpoint; }
SampleBoxSize = Input(SampleBoxSize: int = 250)  # This is the size of the sample box to create at the point selected. This sample box will be used to filter points.
py_localboudingbox = Python(IN[0]=code_block_7, IN[1]=SampleBoxSize)
# ---------- py_localboudingbox.python (22 lines) ----------
# Python coding credit to Dynamo Forum user - @Ewan_Opie 2021
# Sastrugi Package https://sites.google.com/view/sastrugi/home

import sys
import clr
clr.AddReference('ProtoGeometry')
from Autodesk.DesignScript.Geometry import *

basePt = IN[0]
boxSize = IN[1]

c1 = Geometry.Translate(basePt,Vector.XAxis(),boxSize/2)
c1a = Geometry.Translate(c1,Vector.YAxis(),boxSize/2)
c1b = Geometry.Translate(c1a,Vector.ZAxis(),boxSize/2)

c2 = Geometry.Translate(basePt,Vector.Reverse(Vector.XAxis()),boxSize/2)
c2a = Geometry.Translate(c2,Vector.Reverse(Vector.YAxis()),boxSize/2)
c2b = Geometry.Translate(c2a,Vector.Reverse(Vector.ZAxis()),boxSize/2)

box = Cuboid.ByCorners(c1b,c2b)

OUT = box
# ----------------------------------------
code_block_8 = CodeBlock(input_solid=py_localboudingbox) { input_solid; }
centroid_3 = Solid.Centroid(solid=code_block_8)
ZAxis_3 = Vector.ZAxis()
byOriginNormal_4 = Plane.ByOriginNormal(origin=centroid_3, normal=ZAxis_3)
code_block_9 = CodeBlock { 1.01; }
scale_3 = Geometry.Scale(geometry=code_block_8, plane=byOriginNormal_4, xamount=code_block_9, yamount=code_block_9, zamount=code_block_9)
faces_2 = Topology.Faces(topology=scale_3)
vertices_2 = Face.Vertices(face=faces_2)
pointGeometry_2 = Vertex.PointGeometry(vertex=vertices_2)
byBestFitThroughPoints_2 = Plane.ByBestFitThroughPoints(points=pointGeometry_2)
origin_2 = Plane.Origin(plane=byBestFitThroughPoints_2)
centroid_4 = Solid.Centroid(solid=code_block_8)
byTwoPoints_2 = Vector.ByTwoPoints(start=origin_2, end=centroid_4, lacing=Longest)
byOriginNormal_5 = Plane.ByOriginNormal(origin=origin_2, normal=byTwoPoints_2)
SamplePointSize = Input(SamplePointSize: int = 1000)  # This is the number of points to take from within the Pointcloud.
py_pc_filter_2 = Python(IN[0]=code_block_2.out1, IN[1]=byOriginNormal_5, IN[2]=SamplePointSize)
# ---------- py_pc_filter_2.python (49 lines) ----------
# Python coding credit to Dynamo Forum user - @Ewan_Opie 2021
# Sastrugi Package https://sites.google.com/view/sastrugi/home

import clr
clr.AddReference('ProtoGeometry')
from Autodesk.DesignScript.Geometry import *

clr.AddReference("RevitNodes")
import Revit
clr.ImportExtensions(Revit.Elements)

clr.ImportExtensions(Revit.GeometryConversion)

clr.AddReference("RevitServices")
import RevitServices
from RevitServices.Persistence import DocumentManager
from RevitServices.Transactions import TransactionManager
from System.Collections.Generic import *

clr.AddReference("RevitAPI")
import Autodesk
from Autodesk.Revit.DB import *
from Autodesk.Revit.DB.PointClouds import *

doc = DocumentManager.Instance.CurrentDBDocument
uiapp = DocumentManager.Instance.CurrentUIApplication
app = uiapp.Application
uidoc=DocumentManager.Instance.CurrentUIApplication.ActiveUIDocument

PL=[]
for i in IN[1]:
	PL.append(UnwrapElement(i).ToPlane())

IPL=List[Autodesk.Revit.DB.Plane](PL)

PLfilter=PointCloudFilterFactory.CreateMultiPlaneFilter(PL)

dist = 0.001
sample= IN[2]

points = UnwrapElement(IN[0]).GetPoints(PLfilter, dist, sample)
pointsample=[]
for p in points:
	X=p.X
	Y=p.Y
	Z=p.Z
	pointsample.append(Point.Create(XYZ(X,Y,Z)).ToProtoType(True))

OUT = pointsample
# ----------------------------------------
flatten_4 = List.Flatten(list=py_pc_filter_2)
scale_4 = Geometry.Scale(geometry=flatten_4, xamount=getParameterValueByName, yamount=getParameterValueByName, zamount=getParameterValueByName)
transform_2 = Geometry.Transform(geometry=scale_4, fromCoordinateSystem=identity, contextCoordinateSystem=byPlane, lacing=Longest)
Points = Output(transform_2)
