# Dynamo custom node __Random_Point_Cube.dyf "❄_Random Point Cube" (Dynamo 2.0.3.8810)
# category: Sastrugi.Points
# (Sastrugi_Points) This node creates and controls the density of random points within a defined maximum cube space.

MaximumSize = Input(MaximumSize: var[]..[])
Density = Input(Density: double = 0.5)  # Range 0 min to 1 max
code_block = CodeBlock(maxsize=MaximumSize, desity=Density) { 0; maxsize; desity; }

# group: Size Control
randomList = Math.RandomList(amount=code_block.maxsize)
minimumItem = List.MinimumItem(list=randomList)
maximumItem = List.MaximumItem(list=randomList)
randomList_2 = Math.RandomList(amount=code_block.maxsize)
mapTo = Math.MapTo(rangeMin=minimumItem, rangeMax=maximumItem, inputValue=randomList_2, targetRangeMin=code_block.out0, targetRangeMax=code_block.maxsize)
minimumItem_2 = List.MinimumItem(list=randomList_2)
maximumItem_2 = List.MaximumItem(list=randomList_2)
mapTo_2 = Math.MapTo(rangeMin=minimumItem_2, rangeMax=maximumItem_2, inputValue=randomList_2, targetRangeMin=code_block.out0, targetRangeMax=code_block.maxsize)
randomList_3 = Math.RandomList(amount=code_block.maxsize)
minimumItem_3 = List.MinimumItem(list=randomList_3)
maximumItem_3 = List.MaximumItem(list=randomList_3)
mapTo_3 = Math.MapTo(rangeMin=minimumItem_3, rangeMax=maximumItem_3, inputValue=randomList_3, targetRangeMin=code_block.out0, targetRangeMax=code_block.maxsize)

# group: Density Control
code_block_2 = CodeBlock(a=code_block.maxsize) { a-1; }
code_block_3 = CodeBlock(x=code_block_2) { 0..x; }
shuffle = List.Shuffle(list=code_block_3)
shuffle_2 = List.Shuffle(list=code_block_3)
shuffle_3 = List.Shuffle(list=mapTo)
shuffle_4 = List.Shuffle(list=code_block_3)
code_block_4 = CodeBlock { 0; 1; }
mapTo_4 = Math.MapTo(rangeMin=code_block_4.out0, rangeMax=code_block_4.out1, inputValue=Density, targetRangeMin=code_block_4.out0, targetRangeMax=code_block.maxsize)
takeItems = List.TakeItems(list=shuffle_4, amount=mapTo_4)
getItemAtIndex = List.GetItemAtIndex(list=shuffle_3, index=takeItems)
shuffle_5 = List.Shuffle(list=mapTo_2)
takeItems_2 = List.TakeItems(list=shuffle_4, amount=mapTo_4)
getItemAtIndex_2 = List.GetItemAtIndex(list=shuffle_5, index=takeItems_2)
shuffle_6 = List.Shuffle(list=mapTo_3)
takeItems_3 = List.TakeItems(list=shuffle_4, amount=mapTo_4)
getItemAtIndex_3 = List.GetItemAtIndex(list=shuffle_6, index=takeItems_3)

byCoordinates = Point.ByCoordinates(x=getItemAtIndex, y=getItemAtIndex_2, z=getItemAtIndex_3)
RandomPoints = Output(byCoordinates)
