# Dynamo custom node __Set_Sketchplane_By_View.dyf "❄_Set Sketchplane By View" (Dynamo 2.0.3.8810)
# category: Sastrugi.Selection
# (Sastrugi_Selection) This node allows users to set the Active Sketchplane to be the Active View Plane.

code_block = CodeBlock { document1 = Application.Document.Current; view1 = document1.ActiveView; }
flatten = List.Flatten(list=code_block.view1)
Refresh = Input(Refresh: bool = false)
python_script = Python(IN[0]=flatten, IN[1]=Refresh)
# ---------- python_script.python (20 lines) ----------
import clr
clr.AddReference('RevitAPI')
from Autodesk.Revit.DB import *

clr.AddReference("RevitNodes")
import Revit
clr.ImportExtensions(Revit.GeometryConversion)

items = UnwrapElement(IN[0])
elementlist = list()
olist = list()
dlist = list()

for item in items:
	try:
		olist.append(item.Origin.ToPoint())
		dlist.append(item.ViewDirection.ToVector())
	except:
		elementlist.append(None)
OUT = (olist,dlist)
# ----------------------------------------
code_block_2 = CodeBlock(seq=python_script) { seq[0]; seq[1]; }
byOriginNormal = Plane.ByOriginNormal(origin=code_block_2.out0, normal=code_block_2.out1)
byPlane = SketchPlane.ByPlane(plane=byOriginNormal)
firstItem = List.FirstItem(list=byPlane)

# group: Credit @Einar_Raknes for coding
python_script_2 = Python(IN[0]=firstItem)
# ---------- python_script_2.python (34 lines) ----------
import clr
clr.AddReference('ProtoGeometry')
from Autodesk.DesignScript.Geometry import *

clr.AddReference("RevitNodes")
import Revit
clr.ImportExtensions(Revit.Elements)

clr.ImportExtensions(Revit.GeometryConversion)

clr.AddReference("RevitServices")
import RevitServices
from RevitServices.Persistence import DocumentManager
from RevitServices.Transactions import TransactionManager

doc = DocumentManager.Instance.CurrentDBDocument
uiapp = DocumentManager.Instance.CurrentUIApplication
app = uiapp.Application

clr.AddReference("RevitAPI")
import Autodesk
from Autodesk.Revit.DB import *

doc = DocumentManager.Instance.CurrentDBDocument
uiapp = DocumentManager.Instance.CurrentUIApplication
app = uiapp.Application

sp =  UnwrapElement(IN[0])

TransactionManager.Instance.EnsureInTransaction(doc)
doc.ActiveView.SketchPlane = sp
TransactionManager.Instance.TransactionTaskDone()

OUT = sp
# ----------------------------------------

SketchPlane = Output(python_script_2)
