# Dynamo custom node __Sort_Points_as_Perimeter.dyf "❄_Sort Points as Perimeter" (Dynamo 2.0.3.8810)
# category: Sastrugi.Points
# (Sastrugi_Points) This node takes a list of unsorted Points and orders them (clockwise/anti-clockwise around a centroid) to create a Perimeter. Useful for Polycurves and Surfaces.

ClockwiseSorting = Input(ClockwiseSorting: bool = true)
UnsortedPoints = Input(UnsortedPoints: var[]..[])
code_block = CodeBlock(pts=UnsortedPoints) { Autodesk.Point.ByCoordinates(Math.Average(pts.X),Math.Average(pts.Y),Math.Average(pts.Z)); }
byTwoPoints = Vector.ByTwoPoints(start=code_block, end=UnsortedPoints)
byBestFitThroughPoints = Line.ByBestFitThroughPoints(bestFitPoints=UnsortedPoints)
code_block_2 = CodeBlock { 0.5; }
normalAtParameter = Curve.NormalAtParameter(curve=byBestFitThroughPoints, param=code_block_2)
byBestFitThroughPoints_2 = Plane.ByBestFitThroughPoints(points=UnsortedPoints)
normal = Plane.Normal(plane=byBestFitThroughPoints_2)
angleAboutAxis = Vector.AngleAboutAxis(vector=byTwoPoints, otherVector=normalAtParameter, rotationAxis=normal)
sortIndexByValue = List.SortIndexByValue(list=angleAboutAxis)
getItemAtIndex = List.GetItemAtIndex(list=UnsortedPoints, index=sortIndexByValue)
reverse = List.Reverse(list=getItemAtIndex)
if_ = If(test=ClockwiseSorting, true=getItemAtIndex, false=reverse)
StartPoint = Input(StartPoint: var[]..[])
indexOf = List.IndexOf(list=if_, element=StartPoint)
code_block_3 = CodeBlock(l1=if_, amt=indexOf) { DSCore.List.TakeItems(l1, amt); DSCore.List.DropItems(l1, amt); }
join = List.Join(list0=code_block_3.out1, list1=code_block_3.out0)
PerimeterPoints = Output(join)
