# Dynamo custom node __Sort_Points_by_Average_Vector.dyf "❄_Sort Points by Average Vector" (Dynamo 2.0.3.8810)
# category: Sastrugi.Points
# (Sastrugi_Points) This node sorts points by the average vector through them.

ReverseVector = Input(ReverseVector: bool = false)
UnsortedPoints = Input(UnsortedPoints: var[]..[])
flatten = List.Flatten(list=UnsortedPoints)
byBestFitThroughPoints = Line.ByBestFitThroughPoints(bestFitPoints=flatten)
parameterAtPoint = Curve.ParameterAtPoint(curve=byBestFitThroughPoints, point=UnsortedPoints)
sortIndexByValue = List.SortIndexByValue(list=parameterAtPoint)
getItemAtIndex = List.GetItemAtIndex(list=UnsortedPoints, index=sortIndexByValue)
flatten_2 = List.Flatten(list=getItemAtIndex)
code_block = CodeBlock { true; }
clean = List.Clean(list=flatten_2, preserveIndices=code_block)
reverse = List.Reverse(list=clean)
if_ = If(test=ReverseVector, true=reverse, false=clean)
SortedPoints = Output(if_)
