# Dynamo custom node __Split_List_At_Index.dyf "❄_Split List At Index" (Dynamo 2.2.1.5175)
# category: Sastrugi.Lists
# (Sastrugi_Lists) This node splits a list by at the Index locations of specific Elements.

InputList = Input(InputList: var[]..[])
flatten = List.Flatten(list=InputList)
ElementList = Input(ElementList: var[]..[])
indexOf = List.IndexOf(list=flatten, element=ElementList@L1)
count = List.Count(list=flatten)
addItemToFront = List.AddItemToFront(item=indexOf, list=count)
flatten_2 = List.Flatten(list=addItemToFront)
deconstruct = List.Deconstruct(list=flatten_2)
sub = flatten_2 - deconstruct.rest
code_block = CodeBlock(a=sub) { a*-1; }
addItemToFront_2 = List.AddItemToFront(item=deconstruct.first, list=code_block)
chop = List.Chop(list=flatten, lengths=addItemToFront_2)
List = Output(chop)
