# Dynamo custom node __Surface_Plane.dyf "❄_Surface Plane" (Dynamo 2.0.3.8810)
# category: Sastrugi.Geometry
# (Sastrugi_Geometry) This node will extract a plane that best fits a surface.

InputSurfaces = Input(InputSurfaces: var[]..[])

# group: Convert Surfaces to Planes
faces = Topology.Faces(topology=InputSurfaces)
vertices = Face.Vertices(face=faces)
pointGeometry = Vertex.PointGeometry(vertex=vertices)
byBestFitThroughPoints = Plane.ByBestFitThroughPoints(points=pointGeometry)

Planes = Output(byBestFitThroughPoints)
