# Dynamo custom node __Waveform.dyf "❄_Waveform" (Dynamo 2.0.3.8810)
# category: Sastrugi.Curves
# (Sastrugi_Curves) This node generates a curve waveform, with controls for Amplitude, Wavelength, Wavestage and Sample Length.

Wavelength = Input(Wavelength: var[])
Amplitude = Input(Amplitude: var[])
WaveStage = Input(WaveStage: var[])
SampleLength = Input(SampleLength: var[])
code_block = CodeBlock(wavelength=Wavelength, amplitude=Amplitude, wavestage=WaveStage, samplelength=SampleLength) { wavelength; amplitude; wavestage; samplelength; }
code_block_2 = CodeBlock(SL=code_block.samplelength) { 0..SL; }
code_block_3 = CodeBlock(SL=code_block.samplelength, WL=code_block.wavelength) { 0..SL*10..WL; }
code_block_4 = CodeBlock(A=code_block.amplitude, w=code_block_3, t=code_block.wavelength, phi=code_block.wavestage) { A*Math.Sin(w*t+phi); }
byCoordinates = Point.ByCoordinates(x=code_block_2, z=code_block_4)
byControlPoints = NurbsCurve.ByControlPoints(points=byCoordinates)
WaveformCurve = Output(byControlPoints)
