# Dynamo graph TestWriteDefinition.dyn (Dynamo 2.10.1.3976)
# packages: SketchUpForDynamo 1.6.0

byCoordinates = Point.ByCoordinates()
code_block = CodeBlock { 100; }
byCoordinates_2 = Point.ByCoordinates(x=code_block)
byCoordinates_3 = Point.ByCoordinates(x=code_block, y=code_block)
byCoordinates_4 = Point.ByCoordinates(y=code_block)
byCornerPoints = Rectangle.ByCornerPoints(p1=byCoordinates, p2=byCoordinates_2, p3=byCoordinates_3, p4=byCoordinates_4)
byPatch = Surface.ByPatch(closedCurve=byCornerPoints)
byStartPointEndPoint = Line.ByStartPointEndPoint(startPoint=byCoordinates, endPoint=byCoordinates_2)
writeModel = SketchUpForDynamo.SketchUp.WriteModel(surfaces=byPatch, curves=byStartPointEndPoint)  # unwired: path
