# Dynamo custom node Elementsinsystemtype.dyf (Dynamo 2.5.0.7460)
# category: Smort
# Get all the piping elements in the specific system type

SystemType = Input(SystemType: string)
piping_elements_in_a_pipe_system = Python(IN[0]=SystemType)
# ---------- piping_elements_in_a_pipe_system.python (141 lines) ----------
# Load the Python Standard and DesignScript Libraries
import clr
import sys
sys.path.append('C:\Program Files (x86)\IronPython 2.7\Lib')
import System
from System import Array
from System.Collections.Generic import *
clr.AddReference('ProtoGeometry')
from Autodesk.DesignScript.Geometry import *
clr.AddReference("RevitNodes")
import Revit
clr.ImportExtensions(Revit.Elements)
clr.ImportExtensions(Revit.GeometryConversion)
clr.AddReference("RevitServices")
import RevitServices
from RevitServices.Persistence import DocumentManager 
from RevitServices.Transactions import TransactionManager 
clr.AddReference("RevitAPI")
clr.AddReference("RevitAPIUI")
import Autodesk 
from Autodesk.Revit.DB import *
from Autodesk.Revit.UI import *
doc = DocumentManager.Instance.CurrentDBDocument
uiapp = DocumentManager.Instance.CurrentUIApplication 
app = uiapp.Application 
uidoc = uiapp.ActiveUIDocument

# The inputs to this node will be stored as a list in the IN variables.
dataEnteringNode = IN

pipe_system = IN[0]

pi =  FilteredElementCollector(doc).OfCategory(BuiltInCategory.OST_PipeCurves).WhereElementIsNotElementType().ToElements()
pi_id = []
for i in pi:
	pi_id.append(str(i.Id))

pia =  FilteredElementCollector(doc).OfCategory(BuiltInCategory.OST_PipeAccessory).WhereElementIsNotElementType().ToElements()

pia_id = []
for i in pia:
	pia_id.append(str(i.Id))

pif =  FilteredElementCollector(doc).OfCategory(BuiltInCategory.OST_PipeFitting).WhereElementIsNotElementType().ToElements()
pif_id = []
for i in pif:
	pif_id.append(str(i.Id))

flexpi =  FilteredElementCollector(doc).OfCategory(BuiltInCategory.OST_FlexPipeCurves).WhereElementIsNotElementType().ToElements()
flexpi_id = []
for i in flexpi:
	flexpi_id.append(str(i.Id))

pisys_name = []
for i in pi:
	n = i.get_Parameter(BuiltInParameter.RBS_PIPING_SYSTEM_TYPE_PARAM).AsValueString()
	pisys_name.append(n)

piasys_name = []
for i in pia:
	n = i.get_Parameter(BuiltInParameter.RBS_PIPING_SYSTEM_TYPE_PARAM).AsValueString()
	piasys_name.append(n)

pifsys_name = []
for i in pif:
	n = i.get_Parameter(BuiltInParameter.RBS_PIPING_SYSTEM_TYPE_PARAM).AsValueString()
	pifsys_name.append(n)

flexpisys_name = []
for i in flexpi:
	n = i.get_Parameter(BuiltInParameter.RBS_PIPING_SYSTEM_TYPE_PARAM).AsValueString()
	flexpisys_name.append(n)

allpi = [pi_id,pia_id,pif_id,flexpi_id]
allpisys = [pisys_name,piasys_name,pifsys_name,flexpisys_name]
allele_nonflattenlist = [pi,pia,pif,flexpi]
#allpisys = pisys_name

allpi_id = []
for i in allpi:
	for j in i:
		allpi_id.append(j)


allpisys_name = []
for i in allpisys:
	for j in i:
		allpisys_name.append(j)

id_sys_dict = dict(zip(allpi_id,allpisys_name))

str_id = []
for key,val in id_sys_dict.items():
	if val == pipe_system:
		str_id.append(key)
	
allele = []
for i in allele_nonflattenlist:
	for j in i:
		allele.append(j)
		
id_ele_dict = dict(zip(allpi_id,allele))

ele = []
for i in str_id:
	for key,val in id_ele_dict.items():
		if i == key:
			ele.append(val)
			
ele_overallsize = []			
for i in ele:
	j = i.get_Parameter(BuiltInParameter.RBS_REFERENCE_OVERALLSIZE).AsString()
	ele_overallsize.append(j)

ele_category = []
for i in ele:
	j = i.get_Parameter(BuiltInParameter.ELEM_CATEGORY_PARAM).AsValueString()
	ele_category.append(j)	

ele_insulation = []
for i in ele:
	j = i.get_Parameter(BuiltInParameter.RBS_REFERENCE_INSULATION_THICKNESS).AsValueString()
	ele_insulation.append(j)

ele_pipetype = []
for i in ele:
	j = i.get_Parameter(BuiltInParameter.ELEM_FAMILY_AND_TYPE_PARAM).AsValueString()
	ele_pipetype.append(j)

ele_workset = []
for i in ele:
	j = i.get_Parameter(BuiltInParameter.ELEM_PARTITION_PARAM).AsValueString()
	ele_workset.append(j)

ele_id = []
for i in ele:
	j = i.Id
	ele_id.append(j)
	
# Assign your output to the OUT variable.
OUT = ele,ele_overallsize,ele_category,ele_insulation,ele_pipetype,ele_workset,ele_id
# ----------------------------------------
code_block = CodeBlock(x=piping_elements_in_a_pipe_system) { x[0]; }
Element = Output(code_block)
code_block_2 = CodeBlock(x=piping_elements_in_a_pipe_system) { x[1]; }
Overall_Size = Output(code_block_2)
code_block_3 = CodeBlock(x=piping_elements_in_a_pipe_system) { x[2]; }
Category = Output(code_block_3)
code_block_4 = CodeBlock(x=piping_elements_in_a_pipe_system) { x[3]; }
Pipe_Insulation = Output(code_block_4)
code_block_5 = CodeBlock(x=piping_elements_in_a_pipe_system) { x[4]; }
Pipe_Type = Output(code_block_5)
code_block_6 = CodeBlock(x=piping_elements_in_a_pipe_system) { x[5]; }
Workset = Output(code_block_6)
code_block_7 = CodeBlock(x=piping_elements_in_a_pipe_system) { x[6]; }
Element_Id = Output(code_block_7)
