# Dynamo graph Grout.Tubes.dyn (Dynamo 2.3.0.5885)
# packages: Structural Design 2019.11.8

# group: DESCRIPTION
# note: DYNAMO FILE NAME
# Grout Tubes.dyn
# note: AUTHOR
# Tomasz Fudala (Autodesk)
# note: DESCRIPTION
# Add grout tubes and tubes on top to a precast wall.
# note: DYNAMO REVIT VERSION
# 2.3
# note: WORKING REVIT VERSION(S)
# 2020.2
# note: ADDITIONAL REQUIREMENTS
# The Structural Design package (ver. 2019.11.9) is needed.

# group: Input Parameters
grout_tube = FamilyTypes("Solid Wall - Grout tubes:D24")  # graph input
select_faces = SelectFaces()  # nothing selected; graph input
distance_from_edge_mm = DoubleInput(500)  # graph input
max_distance_between_elements_mm = DoubleInput(2000)  # graph input
ignore_max_distance_between = BoolSelector(false)  # "Ignore Max Distance Between Elements"; graph input
number_of_grout_tubes = IntegerSlider(4, range=2..8 step 1)  # graph input
tube_on_top = FamilyTypes("Solid Wall - Tube On Top:D24")  # graph input

# group: Check the Orientation of Faces
area = Surface.Area()  # unwired: surface
sortByFunction = List.SortByFunction(list=select_faces@L2, func=area)
reverse = List.Reverse(list=sortByFunction@L2)
index = CodeBlock { 0; }
# note: Get the main surface of the selected face.
getItemAtIndex = List.GetItemAtIndex(list=reverse@L2, index=index)
wallOriginLocation = StructuralDesign.Model.Geometry.WallOriginLocation(wallFace=getItemAtIndex)
groutTubeRotationAngle = StructuralDesign.Precast.Computation.GroutTubeRotationAngle(surface=getItemAtIndex)

# group: Wall Part Length
perimeterCurves = Surface.PerimeterCurves(surface=getItemAtIndex)
startPoint = Curve.StartPoint(curve=perimeterCurves)
Z = Point.Z()  # unwired: point
sortByFunction_2 = List.SortByFunction(list=startPoint@L2, func=Z)
reverse_2 = List.Reverse(list=sortByFunction_2@L2)
index_2 = CodeBlock { 0; }
getItemAtIndex_2 = List.GetItemAtIndex(list=reverse_2@L2, index=index_2)
index_3 = CodeBlock { 1; }
getItemAtIndex_3 = List.GetItemAtIndex(list=reverse_2@L2, index=index_3)
distanceTo = Geometry.DistanceTo(geometry=getItemAtIndex_2, other=getItemAtIndex_3)
code_block = CodeBlock { 0; }
# note: Wall Part Length
round = Math.Round(number=distanceTo, digits=code_block)

# group: Points of Insertion
u = CodeBlock(location=wallOriginLocation) { location=="BOTTOM"?0:1; }
code_block_2 = CodeBlock(n=number_of_grout_tubes) { n-1; }
pointParameterBasedOnDivision = StructuralDesign.Precast.Computation.PointParameterBasedOnDivision(length=round, startEndOffset=distance_from_edge_mm, maxSpacing=max_distance_between_elements_mm, ignoreSpacing=ignore_max_distance_between, divisionNumber=code_block_2)
# note: Grout Tubes insertion point.
pointAtParameter = Surface.PointAtParameter(surface=getItemAtIndex, u=u, v=pointParameterBasedOnDivision)
u_2 = CodeBlock(location=wallOriginLocation) { location=="BOTTOM"?1:0; }
# note: Tubes on Top insertion point.
pointAtParameter_2 = Surface.PointAtParameter(surface=getItemAtIndex, u=u_2, v=pointParameterBasedOnDivision)

# group: Adding Grout Tubes and Tubes on Top
ZAxis = Vector.ZAxis()
# note: Add Grout Tubes
byFace = FamilyInstance.ByFace(familyType=grout_tube, face=getItemAtIndex, location=pointAtParameter, referenceDirection=ZAxis)
setRotation = FamilyInstance.SetRotation(familyInstance=byFace, degree=groutTubeRotationAngle)
# note: Add Tubes on Top
byFace_2 = FamilyInstance.ByFace(familyType=tube_on_top, face=getItemAtIndex, location=pointAtParameter_2, referenceDirection=ZAxis)
setRotation_2 = FamilyInstance.SetRotation(familyInstance=byFace_2, degree=groutTubeRotationAngle)
