# Dynamo graph Load.Combinations.dyn (Dynamo 2.13.1.3887)
# packages: Structural Design 2022.4.17

# group: Load Cases
loadCase = RevitLoadCase("Self-weight")
loadCase_2 = RevitLoadCase("Dead Load")
loadCase_3 = RevitLoadCase("Snow")
loadCase_4 = RevitLoadCase("Roof Live")
loadCase_5 = RevitLoadCase("Live Load 1")
loadCase_6 = RevitLoadCase("Live Load 2")
loadCase_7 = RevitLoadCase("Live Load 3")

# group: LRFD: 1.2D + 1.6L + 0.5(LR or S or R)
dead_load = CodeBlock(D1=loadCase, D2=loadCase_2) { [D1, D2]; }
snow_load_or_live_roof_load = CodeBlock(S=loadCase_3, R=loadCase_4) { [S, R, ""]; }
live_load = CodeBlock(L1=loadCase_5, L2=loadCase_6, L3=loadCase_7) { [L1, L2, L3]; }
code_block = CodeBlock { [1, 2, 3]; }
combinations = List.Combinations(list=live_load, length=code_block)
code_block_2 = CodeBlock { 1; }
live_load_2 = List.Flatten(list=combinations, amount=code_block_2)
factors = CodeBlock { [1.2, 0.5, 1.6]; }
python_script = Python(IN[0]=dead_load, IN[1]=snow_load_or_live_roof_load, IN[2]=live_load_2, IN[3]=factors)  # CPython3
# ---------- python_script.python (36 lines) ----------
# Load the Python Standard and DesignScript Libraries
import sys
import clr
clr.AddReference('ProtoGeometry')
from Autodesk.DesignScript.Geometry import *

# The inputs to this node will be stored as a list in the IN variables.
dataEnteringNode = IN

# Place your code below this line

dead = IN[0]
snow = IN[1]
live = IN[2]
factors = IN[3]

# LOAD COMBINATIONS according to ASCE7-10
# 1.2D + 1.6L + 0.5(Lr or S or R)

outputList = []

for l in live:
	for s in snow:
		listItem = []
		for d in dead:
			listItem.append([d, factors[0]])
		if isinstance(l, list):
			for i in l:
				listItem.append([i, factors[2]])
		if s != "":
			listItem.append([s, factors[1]])
		outputList.append(listItem)


# Assign your output to the OUT variable.
OUT = outputList
# ----------------------------------------

# group: Load Combinations
code_block_3 = CodeBlock(n=python_script) { "Combination "; 1..List.Count(n); }
add = code_block_3.out0 + code_block_3.out1
loadCombinationType = RevitLoadCombinationType("Combination")
loadCombinationState = RevitLoadCombinationState("Ultimate")
code_block_4 = CodeBlock { 0; }
getItemAtIndex = List.GetItemAtIndex(list=python_script@@L2, index=code_block_4)
code_block_5 = CodeBlock { 1; }
getItemAtIndex_2 = List.GetItemAtIndex(list=python_script@@L2, index=code_block_5)
loadComponent = StructuralDesign.Model.LoadCombinations.Loads.LoadComponent(loadCaseOrCombination=getItemAtIndex, factor=getItemAtIndex_2)
loadCombination = StructuralDesign.Model.LoadCombinations.Loads.LoadCombination(name=add, type=loadCombinationType, state=loadCombinationState, components=loadComponent)
