# Dynamo graph Portal.Frame.3D.dyn (Dynamo 2.3.0.5885)
# packages: Structural Design 2019.11.8

# group: DESCRIPTION
# note: DYNAMO FILE NAME
# Portal.Frame.3D.dyn
# note: AUTHOR
# Tomasz Fudala (Autodesk)
# note: DESCRIPTION
# Generates a 3D portal frame.
# note: ADDITIONAL REQUIREMENTS
# The Structural Design package (ver. 2019.11.9) is needed.
# note: WORKING REVIT VERSION(S)
# 2020.2
# note: DYNAMO REVIT VERSION
# 2.3

width = DoubleSlider(13.9, range=10..25 step 0.1)
height1 = CodeBlock { 4.5; }
number_of_frames = IntegerSlider(6, range=4..10 step 1)
code_block = CodeBlock(n=number_of_frames) { n-1; }

# group: Dynamo Geometry
byWidthHeights = StructuralDesign.Model.Frame.ByWidthHeights(width=width, height1=height1)
copy = StructuralDesign.Model.Frame.Copy(frame2DGeometry=byWidthHeights.2DFrame, numberOfTimes=code_block)
heights = CodeBlock(h=height1) { [h/2, h]; }
sideRailsEavesBeams = StructuralDesign.Model.Frame.SideRailsEavesBeams(columns=copy.Columns, heights=heights)
zones = CodeBlock(n=code_block) { [1, n]; }
VBracings = StructuralDesign.Model.Frame.VBracings(points=sideRailsEavesBeams.Points, zones=zones)
code_block_2 = CodeBlock { 0.25; }
purlins = StructuralDesign.Model.Frame.Purlins(rafters=copy.Beams, dp1=code_block_2, dp2=code_block_2)
code_block_3 = CodeBlock { 2; }
dropEveryNthItem = List.DropEveryNthItem(list=purlins.Points@@L2, n=code_block_3)
XBracings = StructuralDesign.Model.Frame.XBracings(points=dropEveryNthItem, zones=zones)
