# Dynamo graph Rebar.Visibility.dyn (Dynamo 2.3.0.5885)
# packages: Structural Design 2019.11.8

categories = Categories("OST_Rebar")
boolean = BoolSelector(true)
activeSelectionOfCategory = StructuralDesign.Model.Selection.ActiveSelectionOfCategory(category=categories, refresh=boolean)
all_elements_of_category = ElementsOfCategory(Category=categories)
python_script = Python(IN[0]=activeSelectionOfCategory, IN[1]=all_elements_of_category)
# ---------- python_script.python (21 lines) ----------
# Load the Python Standard and DesignScript Libraries
import sys
import clr
clr.AddReference('ProtoGeometry')
from Autodesk.DesignScript.Geometry import *

# The inputs to this node will be stored as a list in the IN variables.
dataEnteringNode = IN

listA = IN[0]
listB = IN[1]

if len(listA) == 0:
	output = listB
else:
	output = listA

# Place your code below this line

# Assign your output to the OUT variable.
OUT = output
# ----------------------------------------
current = Document.Current()
activeView = Document.ActiveView(document=current)
solid = BoolSelector(false)  # graph input
setSolidInView = StructuralDesign.Rebar.Create.SetSolidInView(rebar=python_script, view=activeView, solid=solid)
unobscured = BoolSelector(false)  # graph input
setUnobscuredInView = StructuralDesign.Rebar.Create.SetUnobscuredInView(rebar=python_script, view=activeView, unobscured=unobscured)
