# Dynamo graph Selection.dyn (Dynamo 2.3.0.5885)
# packages: Structural Design 2019.11.8

category_1 = Categories("OST_Doors")  # graph input
category_2 = Categories("OST_Windows")  # graph input
list_create = List.Create(item0=category_1, item1=category_2)
preselection = BoolSelector(false)  # graph input
pickObjectsOfCategory = StructuralDesign.Model.Selection.PickObjectsOfCategory(category=list_create, preselection=preselection)  # graph output
selected_elements = Watch(pickObjectsOfCategory)  # graph output
