# Dynamo graph Spacial.Truss.dyn (Dynamo 2.3.0.5885)
# packages: Structural Design 2019.11.8

# group: DESCRIPTION
# note: DYNAMO, REVIT FILE NAME
# Spacial Truss.dyn, Spacial Truss.rvt
# note: AUTHOR
# Tomasz Fudala (Autodesk)
# note: DESCRIPTION
# The script creates a spacial truss by boundary points or by curves.
# note: DYNAMO REVIT VERSION
# 2.3
# note: WORKING REVIT VERSION(S)
# 2020.2
# note: ADDITIONAL REQUIREMENTS
# The Structural Design package (ver. 2019.11.7) is needed.

# group: Spatial Truss By Four Curves
select_model_element = DSModelElementSelection()  # 1 picked in the model; graph input
select_model_element_2 = DSModelElementSelection()  # 1 picked in the model; graph input
select_model_element_3 = DSModelElementSelection()  # 1 picked in the model; graph input
select_model_element_4 = DSModelElementSelection()  # 1 picked in the model; graph input
list_create = List.Create(item0=select_model_element, item1=select_model_element_2, item2=select_model_element_3, item3=select_model_element_4)
geometry = Element.Geometry(element=list_create)
flatten = List.Flatten(list=geometry)
division_a = IntegerSlider(8, range=3..20 step 1)  # graph input
division_b = IntegerSlider(9, range=3..20 step 1)  # graph input
height = DoubleSlider(1.2, range=1..5 step 0.1)  # graph input
spatialType1ByFourCurves = StructuralDesign.Model.SpatialTrussType1.Truss.SpatialType1ByFourCurves(contourCurves=flatten, divisionA=division_a, divisionB=division_b, depth=height)

# group: Spatial Truss By Points
Z = DoubleSlider(6, range=0..20 step 0.1)
Y = DoubleSlider(10, range=0..20 step 0.1)
X = DoubleSlider(10, range=0..20 step 0.1)
code_block = CodeBlock(Z=Z, Y=Y, X=X) { Point.ByCoordinates(0, 0, Z); Point.ByCoordinates(0, Y, Z); Point.ByCoordinates(X, Y, Z); Point.ByCoordinates(X, 0, Z); }
list_create_2 = List.Create(item0=code_block.out0, item1=code_block.out1, item2=code_block.out2, item3=code_block.out3)
spatialType1ByPoints = StructuralDesign.Model.SpatialTrussType1.Truss.SpatialType1ByPoints(contourPoints=list_create_2)

# group: Spatial Truss By Two Curves
select_model_element_5 = DSModelElementSelection()  # 1 picked in the model; graph input
select_model_element_6 = DSModelElementSelection()  # 1 picked in the model; graph input
list_create_3 = List.Create(item0=select_model_element_5, item1=select_model_element_6)
geometry_2 = Element.Geometry(element=list_create_3)
flatten_2 = List.Flatten(list=geometry_2)
division_a_2 = IntegerSlider(10, range=3..20 step 1)  # graph input
division_b_2 = IntegerSlider(8, range=3..20 step 1)  # graph input
height_2 = DoubleSlider(1.2, range=1..5 step 0.1)  # graph input
spatialType1ByTwoCurves = StructuralDesign.Model.SpatialTrussType1.Truss.SpatialType1ByTwoCurves(contourCurves=flatten_2, divisionA=division_a_2, divisionB=division_b_2, depth=height_2)
