# Dynamo graph Wall.Opening.Reinforcement.dyn (Dynamo 2.16.1.2727)
# packages: Structural Design 2019.11.8

# group: DESCRIPTION
# note: DYNAMO FILE NAME
# Wall Opening Reinforcement.dyn
# note: AUTHOR
# Tomasz Fudala (Autodesk)
# note: DESCRIPTION
# Generates reinforcements for window and door openings (metric version).
# note: DYNAMO REVIT VERSION
# 2.16
# note: WORKING REVIT VERSION(S)
# 2023.1
# note: ADDITIONAL REQUIREMENTS
# The Structural Design package (ver. 2022.12) is needed.

# group: Get Window/Door Opening Characteristics
categories = Categories("OST_Windows")
categories_2 = Categories("OST_Doors")
list_create = List.Create(item0=categories, item1=categories_2)
code_block = CodeBlock { "Click to select multiple windows and doors"; }
refresh = BoolSelector(true)
pickObjectsOfCategory = StructuralDesign.Model.Selection.PickObjectsOfCategory(category=list_create, statusPrompt=code_block, refresh=refresh)
windowDoorOpeningCharacteristics = StructuralDesign.Model.Opening.Geometry.WindowDoorOpeningCharacteristics(opening=pickObjectsOfCategory)
rebarHostCover = StructuralDesign.Rebar.Properties.RebarHostCover(element=windowDoorOpeningCharacteristics.Host)

# group: Input Parameters
diagonal_rebar_length_mm = DoubleInput(660)  # graph input
straight_rebar_extension_mm = DoubleInput(400)  # graph input
straight_rebar_diameter = RevitRebarBarType("H12")  # graph input
stirrup_rebar_diameter = RevitRebarBarType("H8")  # graph input
two_layers = BoolSelector(true)  # graph input
diagonal_rebar_diameter = RevitRebarBarType("H12")  # graph input
top_stirrup_is_closed = BoolSelector(true)  # graph input
stirrup_rebar_height_mm = DoubleInput(360)  # graph input
top_boundary_rebar_spacing_mm = DoubleInput(140)  # graph input
bottom_boundary_spacing_mm = DoubleInput(140)  # graph input
side_boundary_spacing_mm = DoubleInput(180)  # graph input

rebarDiameter = StructuralDesign.Rebar.Properties.RebarDiameter(rebar=straight_rebar_diameter)
rebarDiameter_2 = StructuralDesign.Rebar.Properties.RebarDiameter(rebar=stirrup_rebar_diameter)

# group: Straight Rebars
openingStraightRebarCurves = StructuralDesign.Rebar.Designs.OpeningStraightRebarCurves(curves=windowDoorOpeningCharacteristics.Curves, openingPlane=windowDoorOpeningCharacteristics.Plane, hostWidth=windowDoorOpeningCharacteristics.HostWidth, cover=rebarHostCover.Other, rebarExtension=straight_rebar_extension_mm, category=windowDoorOpeningCharacteristics.Category, rebarDiameter=rebarDiameter, stirrupDiameter=rebarDiameter_2, twoLayers=two_layers)
rebarStyle = RevitRebarStyle("Standard")
rebarHookType = RevitRebarHookType("None")
rebarHookOrientation = RevitRebarHookOrientation("Left")
fromCurve = StructuralDesign.Rebar.Create.FromCurve(curve=openingStraightRebarCurves.Curves, rebarStyle=rebarStyle, rebarBarType=straight_rebar_diameter, startHookType=rebarHookType, endHookType=rebarHookType, startHookOrientation=rebarHookOrientation, endHookOrientation=rebarHookOrientation, hostElement=windowDoorOpeningCharacteristics.Host, vector=openingStraightRebarCurves.Vector)
code_block_2 = CodeBlock(condition1=two_layers, condition2=top_stirrup_is_closed) { (condition1==true && condition2==true)?true:false; }
setLayoutAsFixedNumber = StructuralDesign.Rebar.Layout.SetLayoutAsFixedNumber(rebar=fromCurve, arrayLength=openingStraightRebarCurves.Spacing)
index = CodeBlock { 1; }
getItemAtIndex = List.GetItemAtIndex(list=setLayoutAsFixedNumber@L2, index=index)
code_block_3 = CodeBlock { null; }
if_ = RefactoredIf(test=code_block_2, true=getItemAtIndex, false=code_block_3)
ZAxis = Vector.ZAxis()
code_block_4 = CodeBlock(stirrupRebarHeight=stirrup_rebar_height_mm, stirrupRebarDiameter=rebarDiameter_2, straightRebarDiameter=rebarDiameter) { stirrupRebarHeight - stirrupRebarDiameter - 1.5*straightRebarDiameter; }
scale = Vector.Scale(vector=ZAxis, scale_factor=code_block_4)
copyElement = StructuralDesign.Model.Geometry.CopyElement(element=if_, vector=scale)

rebarDiameter_3 = StructuralDesign.Rebar.Properties.RebarDiameter(rebar=diagonal_rebar_diameter)

# group: Diagonal Rebars
index_2 = CodeBlock { 0; }
getItemAtIndex_2 = List.GetItemAtIndex(list=openingStraightRebarCurves.Spacing@L2, index=index_2)
spacing = CodeBlock(S=getItemAtIndex_2, straightRebarDiameter=rebarDiameter, diagonalRebarDiameter=rebarDiameter_3) { S-straightRebarDiameter-diagonalRebarDiameter; }
openingDiagonalRebarCurves = StructuralDesign.Rebar.Designs.OpeningDiagonalRebarCurves(points=windowDoorOpeningCharacteristics.Points, openingPlane=windowDoorOpeningCharacteristics.Plane, length=diagonal_rebar_length_mm, spacing=spacing, cover=rebarHostCover.Other, rebarDiameter=rebarDiameter_3, straightRebarDiameter=rebarDiameter, category=windowDoorOpeningCharacteristics.Category, twoLayers=two_layers)
rebarStyle_2 = RevitRebarStyle("Standard")
rebarHookType_2 = RevitRebarHookType("None")
rebarHookOrientation_2 = RevitRebarHookOrientation("Left")
fromCurve_2 = StructuralDesign.Rebar.Create.FromCurve(curve=openingDiagonalRebarCurves.Curves, rebarStyle=rebarStyle_2, rebarBarType=diagonal_rebar_diameter, startHookType=rebarHookType_2, endHookType=rebarHookType_2, startHookOrientation=rebarHookOrientation_2, endHookOrientation=rebarHookOrientation_2, hostElement=windowDoorOpeningCharacteristics.Host, vector=openingDiagonalRebarCurves.Vector)
setLayoutAsFixedNumber_2 = StructuralDesign.Rebar.Layout.SetLayoutAsFixedNumber(rebar=fromCurve_2, arrayLength=openingDiagonalRebarCurves.Spacing)

# group: Top Boundary Stirrups
index_3 = CodeBlock { 1; }
getItemAtIndex_3 = List.GetItemAtIndex(list=windowDoorOpeningCharacteristics.Curves@L2, index=index_3)
openingStirrupShapeCurves = StructuralDesign.Rebar.Designs.OpeningStirrupShapeCurves(openingPlane=windowDoorOpeningCharacteristics.Plane, segmentA=stirrup_rebar_height_mm, hostWidth=windowDoorOpeningCharacteristics.HostWidth, cover=rebarHostCover.Other, openingCurve=getItemAtIndex_3)
openingUShapeCurves = StructuralDesign.Rebar.Designs.OpeningUShapeCurves(openingPlane=windowDoorOpeningCharacteristics.Plane, segmentA=stirrup_rebar_height_mm, hostWidth=windowDoorOpeningCharacteristics.HostWidth, cover=rebarHostCover.Other, openingCurve=getItemAtIndex_3)
python_script = Python(IN[0]=top_stirrup_is_closed, IN[1]=openingStirrupShapeCurves.Curves, IN[2]=openingUShapeCurves.Curves)  # CPython3
# ---------- python_script.python (21 lines) ----------
# Enable Python support and load DesignScript library
import clr
clr.AddReference('ProtoGeometry')
from Autodesk.DesignScript.Geometry import *

# The inputs to this node will be stored as a list in the IN variables.
dataEnteringNode = IN

condition = IN[0]
closedStirrups = IN[1]
uShapeStirrups = IN[2]

if condition:
	output = closedStirrups
else:
	output = uShapeStirrups

# Place your code below this line

# Assign your output to the OUT variable.
OUT = output
# ----------------------------------------
code_block_5 = CodeBlock(spacing=top_boundary_rebar_spacing_mm) { spacing/2; }
translate = Geometry.Translate(geometry=python_script, direction=openingStirrupShapeCurves.Vector, distance=code_block_5)
python_script_2 = Python(IN[0]=two_layers, IN[1]=translate)  # CPython3
# ---------- python_script_2.python (20 lines) ----------
# Enable Python support and load DesignScript library
import clr
clr.AddReference('ProtoGeometry')
from Autodesk.DesignScript.Geometry import *

# The inputs to this node will be stored as a list in the IN variables.
dataEnteringNode = IN

# Place your code below this line

twoLayers = IN[0]
rebarCurves = IN[1]

if twoLayers:
	rebarCurves = rebarCurves
else:
	rebarCurves = []

# Assign your output to the OUT variable.
OUT = rebarCurves
# ----------------------------------------
rebarStyle_3 = RevitRebarStyle("StirrupTie")
rebarHookType_3 = RevitRebarHookType("Stirrup/Tie - 135 deg.")
rebarHookType_4 = RevitRebarHookType("None")
if_2 = RefactoredIf(test=top_stirrup_is_closed, true=rebarHookType_3, false=rebarHookType_4)
rebarHookOrientation_3 = RevitRebarHookOrientation("Left")
fromCurves = StructuralDesign.Rebar.Create.FromCurves(curves=python_script_2, rebarStyle=rebarStyle_3, rebarBarType=stirrup_rebar_diameter, startHookType=if_2, endHookType=if_2, startHookOrientation=rebarHookOrientation_3, endHookOrientation=rebarHookOrientation_3, hostElement=windowDoorOpeningCharacteristics.Host, vector=openingStirrupShapeCurves.Vector)
code_block_6 = CodeBlock(t1=getItemAtIndex_3) { Math.Round(DesignScript.Curve.Length(t1), 0); }
arrayLength = CodeBlock(length=code_block_6, spacing=top_boundary_rebar_spacing_mm) { length - spacing; }
setLayoutAsMaximumSpacing = StructuralDesign.Rebar.Layout.SetLayoutAsMaximumSpacing(rebar=fromCurves, spacing=top_boundary_rebar_spacing_mm, arrayLength=arrayLength)

# group: Bottom Boundary Stirrups
python_script_3 = Python(IN[0]=windowDoorOpeningCharacteristics.Category, IN[1]=windowDoorOpeningCharacteristics.Curves, IN[2]=windowDoorOpeningCharacteristics.Plane, IN[3]=windowDoorOpeningCharacteristics.Host)  # CPython3
# ---------- python_script_3.python (27 lines) ----------
# Enable Python support and load DesignScript library
import clr
clr.AddReference('ProtoGeometry')
from Autodesk.DesignScript.Geometry import *

# The inputs to this node will be stored as a list in the IN variables.
dataEnteringNode = IN

# Place your code below this line

categories = IN[0]
curves = IN[1]
planes = IN[2]
hosts = IN[3]
output1 = []
output2 = []
output3 = []


for x in range(0, len(categories)):
	if categories[x] != "Doors":
		output1.append(curves[x][3])
		output2.append(planes[x])
		output3.append(hosts[x])

# Assign your output to the OUT variable.
OUT = output1, output2, output3
# ----------------------------------------
code_block_7 = CodeBlock(output=python_script_3) { curves = output[0]; planes = output[1]; hosts = output[2]; }
openingUShapeCurves_2 = StructuralDesign.Rebar.Designs.OpeningUShapeCurves(openingPlane=code_block_7.planes, segmentA=stirrup_rebar_height_mm, hostWidth=windowDoorOpeningCharacteristics.HostWidth, cover=rebarHostCover.Other, openingCurve=code_block_7.curves)
code_block_8 = CodeBlock(spacing=bottom_boundary_spacing_mm) { spacing/2; }
translate_2 = Geometry.Translate(geometry=openingUShapeCurves_2.Curves, direction=openingUShapeCurves_2.Vector, distance=code_block_8)
python_script_4 = Python(IN[0]=two_layers, IN[1]=translate_2)  # CPython3; same code as python_script_2
rebarStyle_4 = RevitRebarStyle("StirrupTie")
rebarHookType_5 = RevitRebarHookType("None")
rebarHookOrientation_4 = RevitRebarHookOrientation("Left")
fromCurves_2 = StructuralDesign.Rebar.Create.FromCurves(curves=python_script_4, rebarStyle=rebarStyle_4, rebarBarType=stirrup_rebar_diameter, startHookType=rebarHookType_5, endHookType=rebarHookType_5, startHookOrientation=rebarHookOrientation_4, endHookOrientation=rebarHookOrientation_4, hostElement=code_block_7.hosts, vector=openingUShapeCurves_2.Vector)
code_block_9 = CodeBlock(t1=code_block_7.curves) { Math.Round(DesignScript.Curve.Length(t1), 0); }
arrayLength_2 = CodeBlock(length=code_block_9, spacing=bottom_boundary_spacing_mm) { length - spacing; }
setLayoutAsMaximumSpacing_2 = StructuralDesign.Rebar.Layout.SetLayoutAsMaximumSpacing(rebar=fromCurves_2, spacing=bottom_boundary_spacing_mm, arrayLength=arrayLength_2)

# group: Side Boundary Stirrups
index_4 = CodeBlock { [0, 2]; }
getItemAtIndex_4 = List.GetItemAtIndex(list=windowDoorOpeningCharacteristics.Curves@L2, index=index_4)
openingUShapeCurves_3 = StructuralDesign.Rebar.Designs.OpeningUShapeCurves(openingPlane=windowDoorOpeningCharacteristics.Plane, segmentA=stirrup_rebar_height_mm, hostWidth=windowDoorOpeningCharacteristics.HostWidth, cover=rebarHostCover.Other, openingCurve=getItemAtIndex_4)
code_block_10 = CodeBlock(spacing=side_boundary_spacing_mm) { spacing/2; }
translate_3 = Geometry.Translate(geometry=openingUShapeCurves_3.Curves, direction=openingUShapeCurves_3.Vector, distance=code_block_10)
python_script_5 = Python(IN[0]=two_layers, IN[1]=translate_3)  # CPython3; same code as python_script_2
rebarStyle_5 = RevitRebarStyle("StirrupTie")
rebarHookType_6 = RevitRebarHookType("None")
rebarHookOrientation_5 = RevitRebarHookOrientation("Left")
fromCurves_3 = StructuralDesign.Rebar.Create.FromCurves(curves=python_script_5, rebarStyle=rebarStyle_5, rebarBarType=stirrup_rebar_diameter, startHookType=rebarHookType_6, endHookType=rebarHookType_6, startHookOrientation=rebarHookOrientation_5, endHookOrientation=rebarHookOrientation_5, hostElement=windowDoorOpeningCharacteristics.Host, vector=openingUShapeCurves_3.Vector)
code_block_11 = CodeBlock(t1=getItemAtIndex_4) { Math.Round(DesignScript.Curve.Length(t1), 0); }
arrayLength_3 = CodeBlock(length=code_block_11, spacing=side_boundary_spacing_mm) { length - spacing; }
setLayoutAsMaximumSpacing_3 = StructuralDesign.Rebar.Layout.SetLayoutAsMaximumSpacing(rebar=fromCurves_3, spacing=side_boundary_spacing_mm, arrayLength=arrayLength_3)

# group: Rebar Visibility
flatten = List.Flatten(list=copyElement)
list_create_2 = List.Create(item0=fromCurve, item1=flatten, item2=fromCurve_2, item3=fromCurves, item4=fromCurves_2, item5=fromCurves_3)
current = Document.Current()
activeView = Document.ActiveView(document=current)
viewType = StructuralDesign.Model.Geometry.ViewType(view=activeView)
code_block_12 = CodeBlock(viewType=viewType, currentView=activeView) { viewType == "ThreeD"?currentView:null; }
setSolidInView = StructuralDesign.Rebar.Create.SetSolidInView(rebar=list_create_2, view=code_block_12)
setUnobscuredInView = StructuralDesign.Rebar.Create.SetUnobscuredInView(rebar=list_create_2, view=activeView)
