# Dynamo custom node AL.Get Host Element.dyf (Dynamo 2.1.0.7500)
# category: Synthesize.Packages.archilab.Revit.Elements
# This node will retrieve a host element from hosted element. Ex. feed in door, get wall.

VARhostedElement = Input(VARhostedElement: var[]..[])
python_script = Python(IN[0]=VARhostedElement)
# ---------- python_script.python (68 lines) ----------
#Copyright(c) 2015, Konrad K Sobon
# @arch_laboratory, http://archi-lab.net

import clr
import sys

pyt_path = r'C:\Program Files (x86)\IronPython 2.7\Lib'
sys.path.append(pyt_path)

# Import Element wrapper extension methods
clr.AddReference("RevitNodes")
import Revit
clr.ImportExtensions(Revit.Elements)

# Import DocumentManager and TransactionManager
clr.AddReference("RevitServices")
import RevitServices
from RevitServices.Persistence import DocumentManager
doc = DocumentManager.Instance.CurrentDBDocument

# Import RevitAPI
clr.AddReference("RevitAPI")
import Autodesk
from Autodesk.Revit.DB import *

#The inputs to this node will be stored as a list in the IN variable.
dataEnteringNode = IN

if isinstance(IN[0], list):
	elements = []
	for i in IN[0]:
		elements.append(UnwrapElement(i))
else:
	elements = IN[0]

def GetHostElement(element):
	doc = DocumentManager.Instance.CurrentDBDocument
	try:
		host = element.Host
		return host
	except:
		try:
			hostIds = []
			for i in element.GetHostIds():
				hostIds.append(doc.GetElement(i))
			return hostIds
		except:
			return None

def ProcessList(_func, _list):
	return map( lambda x: ProcessList(_func, x) if type(x) == list else _func(x), _list )

try:
	errorReport = None
	if isinstance(elements, list):
		output = ProcessList(GetHostElement, elements)
	else:
		output = GetHostElement(elements)
except:
	# if error accurs anywhere in the process catch it
	import traceback
	errorReport = traceback.format_exc()

#Assign your output to the OUT variable
if errorReport == None:
	OUT = output
else:
	OUT = errorReport
# ----------------------------------------
VARhostElement = Output(python_script)
