# Dynamo custom node AL.Get Unplaced Groups.dyf (Dynamo 2.1.0.7500)
# category: Synthesize.Packages.Archi-lab_Grimshaw.Selection
# This node will retrieve all unplaced groups in the model.

python_script = Python()  # graph input
# ---------- python_script.python (32 lines) ----------
#Copyright(c) 2015, Konrad Sobon
# @arch_laboratory, http://archi-lab.net

import clr
clr.AddReference('ProtoGeometry')
from Autodesk.DesignScript.Geometry import *

# Import DocumentManager and TransactionManager
clr.AddReference("RevitServices")
import RevitServices
from RevitServices.Persistence import DocumentManager
from RevitServices.Transactions import TransactionManager

# Import RevitAPI
clr.AddReference("RevitAPI")
import Autodesk
from Autodesk.Revit.DB import *

doc = DocumentManager.Instance.CurrentDBDocument
uiapp = DocumentManager.Instance.CurrentUIApplication
app = uiapp.Application

#The inputs to this node will be stored as a list in the IN variable.
dataEnteringNode = IN

groups = FilteredElementCollector(doc).OfClass(GroupType)
unplacedGroups = []
for i in groups:
	gInstances = i.Groups
	if gInstances.IsEmpty == 1:
		unplacedGroups.append(i)
OUT = unplacedGroups
# ----------------------------------------
name = Element.Name(element=python_script)
VARGroupNames = Output(name)
VARGroups = Output(python_script)
