# Dynamo custom node AL.Material.SetMaterialAssetByAssetId.dyf (Dynamo 2.1.0.7500)
# category: Synthesize.Packages.Archi-lab_Grimshaw.Modify
# This node will set the material asset by asset id. Please make sure that the two input lists match in length.

VARTargetMaterial = Input(VARTargetMaterial: var[]..[])
VARAssetId = Input(VARAssetId: var[]..[])
python_script = Python(IN[0]=VARAssetId)
# ---------- python_script.python (29 lines) ----------
import clr

# Import RevitAPI
clr.AddReference("RevitAPI")
import Autodesk

clr.AddReference("RevitNodes")
import Revit

# Import DocumentManager and TransactionManager
clr.AddReference("RevitServices")
import RevitServices
from RevitServices.Persistence import DocumentManager
from RevitServices.Transactions import TransactionManager

# Import geometry conversion extension methods
clr.ImportExtensions(Revit.GeometryConversion)

# Import Element wrapper extension methods
clr.ImportExtensions(Revit.Elements)


idlist = []

for i in IN[0]:
	id = Autodesk.Revit.DB.ElementId(int(i))
	idlist.append(id)

OUT = idlist
# ----------------------------------------
python_script_2 = Python(IN[0]=VARTargetMaterial, IN[1]=python_script)
# ---------- python_script_2.python (80 lines) ----------
# Copyright(c) 2015, Konrad K Sobon
# @arch_laboratory, http://archi-lab.net

# Import Element wrapper extension methods
import clr
clr.AddReference("RevitNodes")
import Revit
clr.ImportExtensions(Revit.Elements)

# Import RevitAPI
clr.AddReference("RevitAPI")
import Autodesk
from Autodesk.Revit.DB import *

# Import DocumentManager and TransactionManager
clr.AddReference("RevitServices")
import RevitServices
from RevitServices.Persistence import DocumentManager
from RevitServices.Transactions import TransactionManager

doc = DocumentManager.Instance.CurrentDBDocument
uiapp = DocumentManager.Instance.CurrentUIApplication
app = uiapp.Application


clr.AddReference("DSCoreNodes")

import sys
pyt_path = r'C:\Program Files (x86)\IronPython 2.7\Lib'
sys.path.append(pyt_path)

import DSCore as ds

#The inputs to this node will be stored as a list in the IN variables.
dataEnteringNode = IN

def ProcessList(_func, _list):
	return map(lambda x: ProcessList(_func, x) if type(x)==list else _func(x), _list)

def ProcessParallelLists(_func, *lists):
	return map( lambda *xs: ProcessParallelLists(_func, *xs) if all(type(x) is list for x in xs) else _func(*xs), *lists )

def SetMaterialAsset(mat, assetId):
	doc = DocumentManager.Instance.CurrentDBDocument
	try:
		assetElem = doc.GetElement(assetId)
		id = assetElem.Id
		mat.AppearanceAssetId = id
		return mat
	except:
		return None
		pass

def Unwrap(item):
	return UnwrapElement(item)

if isinstance(IN[0], list):
	elements = ProcessList(Unwrap, IN[0])
else:
	elements = [Unwrap(IN[0])]


assetIds = UnwrapElement(IN[1])

output = []
try:
	errorReport = None
	TransactionManager.Instance.EnsureInTransaction(doc)
	output = ProcessParallelLists(SetMaterialAsset, elements, assetIds)
	TransactionManager.Instance.TransactionTaskDone()
except:
	# if error accurs anywhere in the process catch it
	import traceback
	errorReport = traceback.format_exc()

#Assign your output to the OUT variable
if errorReport == None:
	OUT = output
else:
	OUT = errorReport
# ----------------------------------------
VARMaterial = Output(python_script_2)
