# Dynamo custom node AL.String.Contains.dyf (Dynamo 2.1.0.7500)
# category: Synthesize.Packages.Archi-lab_Grimshaw.Element Properties.Query
# This node takes a list of strings and checks if any string contains a matching string from filter input.

VARStringList = Input(VARStringList: var[]..[])
VARFilterList = Input(VARFilterList: var[]..[])
python_script = Python(IN[0]=VARStringList, IN[1]=VARFilterList)
# ---------- python_script.python (33 lines) ----------
import clr
import sys
pyt_path = r'C:\Program Files (x86)\IronPython 2.7\Lib'
sys.path.append(pyt_path)

#The inputs to this node will be stored as a list in the IN variable.
dataEnteringNode = IN

def ListContains(item, filter):
	bool = False
	for i in filter:
		if i in item:
			return True
			bool = True
	if not bool:
		return False 

def ProcessListArg(_func, _list, _arg):
	return map( lambda x: ProcessListArg(_func, x, _arg) if type(x)==list else _func(x, _arg), _list )

try:
	errorReport = None
	output = ProcessListArg(ListContains, IN[0], IN[1])
except:
	# if error accurs anywhere in the process catch it
	import traceback
	errorReport = traceback.format_exc()

#Assign your output to the OUT variable
if errorReport == None:
	OUT = output
else:
	OUT = errorReport
# ----------------------------------------
VARmask = Output(python_script)
