# Dynamo custom node AL.Transform Origin.dyf (Dynamo 2.1.0.7500)
# category: Synthesize.Packages.Archi-lab_Grimshaw.Element Properties.Query
# This node will query an element for its Transform (Coordinate System) and then return its Origin point.

VARElement = Input(VARElement: var[]..[])
python_script = Python(IN[0]=VARElement)
# ---------- python_script.python (24 lines) ----------
# Copyright(c) 2015, Konrad K Sobon
# @arch_laboratory, http://archi-lab.net

import clr
clr.AddReference('RevitAPI')
from Autodesk.Revit.DB import *

clr.AddReference("RevitNodes")
import Revit
clr.ImportExtensions(Revit.GeometryConversion)

elements = UnwrapElement(IN[0])

def ProcessList(_func, _list):
    return map( lambda x: ProcessList(_func, x) if type(x)==list else _func(x), _list )

def GetTransformOrigin(element):
	try:
		return element.GetTransform().Origin.ToPoint()
	except:
		return None
		pass

OUT = ProcessList(GetTransformOrigin, elements)
# ----------------------------------------
VAROrigin = Output(python_script)
