# Dynamo custom node AL.Transform.ToPoint.dyf (Dynamo 2.1.0.7500)
# category: Synthesize.Packages.archilab.Revit.Geometry
# This node takes a Transform and an input point that will be translated by the Transform.

VARTransform = Input(VARTransform: var[]..[])
VARPoint = Input(VARPoint: var[]..[])
python_script = Python(IN[0]=VARTransform, IN[1]=VARPoint)
# ---------- python_script.python (63 lines) ----------
# Copyright(c) 2016, Konrad K Sobon
# @arch_laboratory, http://archi-lab.net

import clr
clr.AddReference('ProtoGeometry')
from Autodesk.DesignScript.Geometry import *

# Import Element wrapper extension methods
clr.AddReference("RevitNodes")
import Revit
clr.ImportExtensions(Revit.Elements)

# Import geometry conversion extension methods
clr.ImportExtensions(Revit.GeometryConversion)

# Import DocumentManager and TransactionManager
clr.AddReference("RevitServices")
import RevitServices
from RevitServices.Persistence import DocumentManager
from RevitServices.Transactions import TransactionManager

# Import RevitAPI
clr.AddReference("RevitAPI")
import Autodesk
from Autodesk.Revit.DB import *

import sys
pyt_path = r'C:\Program Files (x86)\IronPython 2.7\Lib'
sys.path.append(pyt_path)

#The inputs to this node will be stored as a list in the IN variable.
dataEnteringNode = IN

def ProcessList(_func, _list):
    return map( lambda x: ProcessList(_func, x) if type(x)==list else _func(x), _list )

def Unwrap(item):
	return UnwrapElement(item)

trans = IN[0][0]

if isinstance(IN[1], list):
	pts = ProcessList(Unwrap, IN[1])
else:
	pts = [Unwrap(IN[1])]

def GetTransformedPoint(pt, t=trans):
	xyz = pt.ToXyz()
	return t.OfPoint(xyz).ToPoint()

try:
	errorReport = None
	output = ProcessList(GetTransformedPoint, pts)
except:
	# if error accurs anywhere in the process catch it
	import traceback
	errorReport = traceback.format_exc()

#Assign your output to the OUT variable
if errorReport == None:
	OUT = output
else:
	OUT = errorReport
# ----------------------------------------
VARPoint_2 = Output(python_script)  # "VARPoint"
