# Dynamo custom node AS.[&] Geometry.SplitByTools.dyf (Dynamo 2.1.0.7500)
# category: Synthesize.Packages.Ampersand.Geometry.Geometry
# Split one piece of geometry (other than a polysurface) by multiple tools

VARgeometry = Input(VARgeometry: var)
VARtools = Input(VARtools: var[])
python_script = Python(IN[0]=VARgeometry, IN[1]=VARtools)
# ---------- python_script.python (37 lines) ----------
# Colin McCrone
# https://twitter.com/ColinMcCrone
# 2016-05-15

import clr
clr.AddReference('ProtoGeometry')
from Autodesk.DesignScript.Geometry import *

def Flatten2D(ls):
	flat = []	
	for x in ls:
		if type(x) is list:
			for y in x:
				flat.append(y)
		else:
			flat.append(x)	
	return flat

# Main function
geom = IN[0]
tools = IN[1]

pieces = []
pieces.append(geom)

for tool in tools:
	assert type(tool) is not list
	newPieces = []
	for piece in pieces:
		assert type(piece) is not list
		try:
			newPieces.append(Flatten2D(Geometry.Split(piece,tool)))
			piece.Dispose()
		except:
			newPieces.append(piece)
	pieces = Flatten2D(newPieces)
OUT = pieces
# ----------------------------------------
VARgeometry_2 = Output(python_script)  # "VARgeometry"
