# Dynamo custom node AS.[&] List.GroupByKey.dyf (Dynamo 2.1.0.7500)
# category: Synthesize.Packages.Ampersand.Data
# Sort the items of a list into groups (sublists) based on the corresponding items of a reference list.  Example: The list {A,B,C,D,E} with the reference list {1,anyWord,4,anyWord,1} will be grouped into lists as { {A,E}, {B,D}, {C} } and the unique references will be {1, anyWord, 4}.

VARobjectList = Input(VARobjectList: var[]..[])
VARkeys = Input(VARkeys: var[])
VARsortKeys = Input(VARsortKeys: bool = true)
python_script = Python(IN[0]=VARobjectList, IN[1]=VARkeys, IN[2]=VARsortKeys)
# ---------- python_script.python (40 lines) ----------
# Sort data into bins according to a matching a set of criteria

import clr

# Get input
data = IN[0]		# Data (list of same length as criteria) to be binned
criteria = IN[1]	# List of criteria related to the data
toSort = IN[2]		# Whether to sort keys

# Find a unique set of values for the criteria, a list of all the bins
# to sort data into
bins = []
bins.append(criteria[0])
sorted = []
sorted.append([])

for i in range(1,len(criteria)):
	if criteria[i] in bins:
		continue
	else:
		bins.append(criteria[i])
		sorted.append([]) # initialize an empty list

# Sort bins if requested
if toSort:
	bins.sort()

# Sort data into bins
for i in range(len(criteria)):
	for j in range(len(bins)):
		if criteria[i] == bins[j]:
			temp = sorted[j]
			temp.append(data[i])
			sorted[j] = temp
			continue

# Assign your output to the OUT variable
OUT = []
OUT.append(sorted)
OUT.append(bins)
# ----------------------------------------
code_block = CodeBlock(OUT=python_script) { OUT[0]; OUT[1]; }
VARgroups = Output(code_block.out0)
VARuniquekeys = Output(code_block.out1)
