# Dynamo custom node AS.[&] List.PickByKey.dyf (Dynamo 2.1.0.7500)
# category: Synthesize.Packages.Ampersand.Data
# Take items from a list whose keys match a given set of choose values. Items and their corresponding keys are output in the order in which they are requested by the set of choose values.  As needed, items may appear multiple times in the output list or not at all.  Choose values that do not correspond to a key value produce a null selection, and all values not matched to a key are given as a third output.

VARlist = Input(VARlist: var[]..[])
VARkeys = Input(VARkeys: var[]..[])
VARpickKeys = Input(VARpickKeys: var[]..[])
python_script = Python(IN[0]=VARlist, IN[1]=VARkeys, IN[2]=VARpickKeys)
# ---------- python_script.python (44 lines) ----------
# Take items from a list whose keys match a given set of choose values. Items and their corresponding keys are output in the order in which they are requested by the set of choose values.  As needed, items may appear multiple times in the output list or not at all.  Choose values that do not correspond to a key value produce a null selection, and all values not matched to a key are given as a third output.
#
# Example input:
#    list			= {A,B,C,D,E}
#    keys			= {1,2,3,4,5}
#    vals			= {2,2,8,5}
#
# Example output:
#    takenItems		= {B,B,null,E}
#    takenKeys		= {2,2,null,5}
#    valNotMatched	= {8}


import clr

# Input
data = IN[0]
keys = IN[1]
vals = IN[2]

# Output
itemsTaken = []
keysTaken = []
valNoMatch = []

# Find an item and a key for each value
for val in vals:
	found = False
	for i in range(len(data)):
		if val == keys[i]:
			itemsTaken.append(data[i])
			keysTaken.append(keys[i])
			found = True
			break
	if not found:
		itemsTaken.append(None)
		keysTaken.append(None)
		valNoMatch.append(val)

# Write output
OUT = []
OUT.append(itemsTaken)
OUT.append(keysTaken)
OUT.append(valNoMatch)
# ----------------------------------------
code_block = CodeBlock(OUT=python_script) { OUT[0]; OUT[1]; OUT[2]; }
VARitemsPicked = Output(code_block.out0)
VARkeysPicked = Output(code_block.out1)
VARkeysNotMatched = Output(code_block.out2)
