# Dynamo custom node AS.[&] List.SortByKey.dyf (Dynamo 2.1.0.7500)
# category: Synthesize.Packages.Ampersand.Data
# Sort a list (or lists) according to the order specified by the key list.

VARlist = Input(VARlist: var[])
VARkeys = Input(VARkeys: var[])
python_script = Python(IN[0]=VARlist, IN[1]=VARkeys)
# ---------- python_script.python (34 lines) ----------
import clr
clr.AddReference('ProtoGeometry')
from Autodesk.DesignScript.Geometry import *

data = IN[0]
keys = IN[1]


for slot in range(len(keys)-1, 0, -1):
	positionOfMax = 0
	
	for location in range(1, slot+1):
		if keys[location] > keys[positionOfMax]:
			positionOfMax = location

	temp = keys[slot]
	keys[slot] = keys[positionOfMax]
	keys[positionOfMax] = temp
	
	# Operate on sublists if they exist or on the
	# list of data itself if there are no sublists
	if isinstance(data[0], list):
		for sublist in range(len(data)):
			temp2 = data[sublist][slot]
			data[sublist][slot] = data[sublist][positionOfMax]
			data[sublist][positionOfMax] = temp2
	else:
		temp2 = data[slot]
		data[slot] = data[positionOfMax]
		data[positionOfMax] = temp2

OUT = []
OUT.append(data)
OUT.append(keys)
# ----------------------------------------
code_block = CodeBlock(OUT=python_script) { OUT[0]; OUT[1]; }
VARsortedlist = Output(code_block.out0)
VARsortedkeys = Output(code_block.out1)
