# Dynamo custom node AS.[&] Overkill ByCurves.dyf (Dynamo 2.1.0.7500)
# category: Synthesize.Packages.Ampersand.Geometry.Curve
# Create polycurves from an unordered list of curves.

VARcurves = Input(VARcurves: Autodesk.DesignScript.Geometry.Curve[])
# note: Assigns curves to groups with unique (arbirary) numbers.
python_script = Python(IN[0]=VARcurves)
# ---------- python_script.python (60 lines) ----------
# Assign curves to groups according to whether they are connected via shared start points and end points.  Group numbers are not important.
# Colin McCrone, 2015-09-28
# Improved By Karam Baki
import clr

import math
clr.AddReference('ProtoGeometry')
from Autodesk.DesignScript.Geometry import *

# Determine whether two points are equal
def PointsEqual(pt1, pt2):
	tolerance = 0.00001
	
	if (math.fabs(pt1.X - pt2.X) < tolerance and
	    math.fabs(pt1.Y - pt2.Y) < tolerance and
	    math.fabs(pt1.Z - pt2.Z) < tolerance):
		return True
	else:
		return False

# Get input
crvs = IN[0]

# List the group to which each curve belongs
crvGroup = [-1 for x in range(len(crvs))]
crvGroup[0] = 0
maxGroupNum = 1


# Find start and end points for each curve
starts = []
ends = []
mids = []
for crv in crvs:
	starts.append(Curve.PointAtParameter(crv,0))
	ends.append(crv.PointAtParameter(1))
	mids.append(crv.PointAtParameter(0.5))

# Find connected groups of curves
for i in range(len(crvs)):
	# Add i to its own group it not already part of a group
	if (crvGroup[i] == -1):
		crvGroup[i] = i
	
	# Find connections
	for j in range(len(crvs)):
		if (i != j and PointsEqual(mids[i], mids[j]) and ((PointsEqual(starts[i], starts[j]) and PointsEqual(ends[i], ends[j])) or (PointsEqual(starts[i], ends[j]) and PointsEqual(ends[i], starts[j])))):
			
			# Add j to i group
			if (crvGroup[j] == -1):
				crvGroup[j] = crvGroup[i]
			# Add j group to i group
			elif (crvGroup[i] != crvGroup[j]):
				oldNum = crvGroup[j]
				for k in range(len(crvs)):
					if (crvGroup[k] == oldNum):
						crvGroup[k] = crvGroup[i]

# Output the (arbitrary) group numbers
OUT = crvGroup
# ----------------------------------------
groupByKey = List.GroupByKey(list=VARcurves, keys=python_script)
firstItem = List.FirstItem(list=groupByKey.groups@L2)
byJoinedCurves = PolyCurve.ByJoinedCurves(curves=firstItem@L1)
VAROverkilled = Output(byJoinedCurves)
