# Dynamo custom node AS.[&] PolyCurve.ByCurves With Failures.dyf (Dynamo 2.1.0.7500)
# category: Synthesize.Packages.Ampersand.Geometry.Curve
# Create polycurves from an unordered list of curves.

VARcurves = Input(VARcurves: Autodesk.DesignScript.Geometry.Curve[])
# note: Assigns curves to groups with unique (arbirary) numbers.
python_script = Python(IN[0]=VARcurves)
# ---------- python_script.python (97 lines) ----------
# Assign curves to groups according to whether they are connected via shared start points and end points.  Group numbers are not important.
# Colin McCrone, 2015-09-28
# Improved By Karam Baki
import clr
# Enable Revit API
clr.AddReference('RevitAPI')
from Autodesk.Revit.DB import *


# Enable DocumentManager and TransactionManager
clr.AddReference('RevitServices')
from RevitServices.Persistence import DocumentManager
from RevitServices.Transactions import TransactionManager

import math
clr.AddReference('ProtoGeometry')
from Autodesk.DesignScript.Geometry import *

doc = DocumentManager.Instance.CurrentDBDocument

def unitconverter(value,doc,frominternal=True):
	if int(DocumentManager.Instance.CurrentUIApplication.Application.VersionNumber) < 2021:
		if frominternal:
			value = UnitUtils.ConvertFromInternalUnits(value,doc.GetUnits().GetFormatOptions(UnitType.UT_Length).DisplayUnits)
		else:
			value = UnitUtils.ConvertToInternalUnits(value,doc.GetUnits().GetFormatOptions(UnitType.UT_Length).DisplayUnits)
	else:
		if frominternal:
			value = UnitUtils.ConvertFromInternalUnits(value,doc.GetUnits().GetFormatOptions(SpecTypeId.Length).GetUnitTypeId())
		else:
			value = UnitUtils.ConvertToInternalUnits(value,doc.GetUnits().GetFormatOptions(SpecTypeId.Length).GetUnitTypeId())
	return value

scaledown = round(unitconverter(0.3048,doc,False),8)
scaleup = round(unitconverter(3.280839895,doc,True),8)

# Determine whether two points are equal
def PointsEqual(pt1, pt2):
	tolerance = 0.00001
	
	if (math.fabs(pt1.X - pt2.X) < tolerance and
	    math.fabs(pt1.Y - pt2.Y) < tolerance and
	    math.fabs(pt1.Z - pt2.Z) < tolerance):
		return True
	else:
		return False

# Get input
crvs = IN[0]

scaledcurves = []
if scaledown != 1:
	for c in crvs:
		scaledcurves.append(Geometry.Scale(c,scaledown,scaledown,scaledown))
	crvs = scaledcurves

# List the group to which each curve belongs
crvGroup = [-1 for x in range(len(crvs))]
crvGroup[0] = 0
maxGroupNum = 1


# Find start and end points for each curve
starts = []
ends = []
for crv in crvs:
	starts.append(Curve.PointAtParameter(crv,0))
	ends.append(crv.PointAtParameter(1))


# Find connected groups of curves
for i in range(len(crvs)):
	# Add i to its own group it not already part of a group
	if (crvGroup[i] == -1):
		crvGroup[i] = i
	
	# Find connections
	for j in range(len(crvs)):
		if (i != j and
			(PointsEqual(starts[i], starts[j]) or
			PointsEqual(starts[i], ends[j]) or
			PointsEqual(ends[i], starts[j]) or
			PointsEqual(ends[i], ends[j]))):
			
			# Add j to i group
			if (crvGroup[j] == -1):
				crvGroup[j] = crvGroup[i]
			# Add j group to i group
			elif (crvGroup[i] != crvGroup[j]):
				oldNum = crvGroup[j]
				for k in range(len(crvs)):
					if (crvGroup[k] == oldNum):
						crvGroup[k] = crvGroup[i]


# Output the (arbitrary) group numbers
OUT = crvGroup,scaleup,scaledown
# ----------------------------------------
code_block = CodeBlock(a=python_script) { a[0]; a[1]; a[2]; }
groupByKey = List.GroupByKey(list=VARcurves, keys=code_block.out0)
byJoinedCurves = PolyCurve.ByJoinedCurves(curves=groupByKey.groups)
isNull = Object.IsNull(obj=byJoinedCurves)
filterByBoolMask = List.FilterByBoolMask(list=groupByKey.groups, mask=isNull)
filterByBoolMask_2 = List.FilterByBoolMask(list=byJoinedCurves, mask=isNull)
mergeByBoolMask = Custom[SP.List.MergeByBoolMask](VARIn=filterByBoolMask.in, VAROut=filterByBoolMask_2.out, VARmask=isNull)  # Merge two lists by a boolean mask list. The true count in the mask should be the same as the length of the true list and vice versa for the false list.
VARpolyCurve = Output(mergeByBoolMask)
VARFailures = Output(isNull)
VAScaleUp = Output(code_block.out1)
VAScaleDown = Output(code_block.out2)
