# Dynamo custom node Adaptive Family Orientation Type.dyf (Dynamo 2.1.0.7500)
# category: Synthesize.Automate.Adaptive
# Adaptive Family Orientation Type (Along With Other Useful Information

VARFamilyType = Input(VARFamilyType: var[]..[])
python_script = Python(IN[0]=VARFamilyType)
# ---------- python_script.python (109 lines) ----------
# Created By Karam Baki : karam@aecedx.com
# Enable Python support and load DesignScript library
# IMPORTANT : ALL DYNAMO DESIGN SCRIPT NODES ARE AS (dg)
import clr
clr.AddReference('ProtoGeometry')
from Autodesk.DesignScript import Geometry as dg

# EXTENSION Enable ToDSType
clr.AddReference('RevitNodes')
import Revit
clr.ImportExtensions(Revit.Elements)

# Enable Revit Elements
from Revit.Elements import *

# EXTENSION Enable Geometry Conversion Methods
clr.ImportExtensions(Revit.GeometryConversion)

# Enable Revit API
clr.AddReference('RevitAPI')
from Autodesk.Revit.DB import *

# Enable DocumentManager and TransactionManager
clr.AddReference('RevitServices')
from RevitServices.Persistence import DocumentManager
from RevitServices.Transactions import TransactionManager

# Enable ICollection List Translate
clr.AddReference("System")
import System.Collections.Generic
from System.Collections.Generic import List

import sys
sys.path.append(r'C:\Program Files (x86)\IronPython 2.7\DLLs')
sys.path.append(r'C:\Program Files (x86)\IronPython 2.7\Lib')
from collections import Iterable

clr.AddReference("RevitAPIUI")
from Autodesk.Revit.UI import TaskDialog

doc = DocumentManager.Instance.CurrentDBDocument
app = doc.Application
alldocs = app.Documents

familytype = UnwrapElement(IN[0])

familyname = familytype.Family.Name.replace(".rfa","").replace(".rvt","").replace(".rft","").replace(".rte","").lower()
hash = doc.__hash__()
opened = False
for d in alldocs:
	if d.Title.replace(".rfa","").replace(".rvt","").replace(".rft","").replace(".rte","").lower() == familyname and d.__hash__() != hash:
		opened = True
	if d.Title.replace(".rfa","").replace(".rvt","").replace(".rft","").replace(".rte","").lower() == familyname and d.__hash__() == hash:
		OUT = TaskDialog.Show("AECedx - Karam", "Please Change Name of The Family\n As It Conflicts With Active Document Name")
		sys.exit()

result = []
desc = []
Pointslist = []
orient = []
if familytype == None:
	sys.exit()
elif AdaptiveComponentInstanceUtils.IsAdaptiveFamilySymbol(familytype) == False:
	sys.exit()

transac = TransactionManager.Instance
transac.ForceCloseTransaction()
fdoc = doc.EditFamily(familytype.Family)
#transac.EnsureInTransaction(fdoc)
collector = FilteredElementCollector(fdoc).OfCategory(BuiltInCategory.OST_AdaptivePoints).ToElements();

vert = []
hori = []
ptype = []
try:
	vert = fdoc.OwnerFamily.CurtainPanelVerticalSpacing
	hori = fdoc.OwnerFamily.CurtainPanelHorizontalSpacing
	ptype = fdoc.OwnerFamily.CurtainPanelTilePattern.ToString()
except:
	pass
	
tp = fdoc.Settings.TilePatterns

physicalpts = []

for each in collector:
	try:
		orient = each.get_Parameter(BuiltInParameter.POINT_ADAPTIVE_ORIENTATION_TYPE).AsInteger()
		result.append(orient)
		if orient == 9:
			desc.append("Instance XYZ")
		elif orient == 8:
			desc.append("Instance Z Then Host XY")
		elif orient == 2:
			desc.append("Host XYZ")
		elif orient == 3:
			desc.append("Host and Loop System XYZ")
		elif orient == 7:
			desc.append("Global XYZ")
		elif orient == 6:
			desc.append("Global Z Then Host XY")
		physicalpts.append(each.GetCoordinateSystem().ToCoordinateSystem().Origin)
	except:
		pass
#transac.ForceCloseTransaction()
if opened == False:
	fdoc.Close(False)

OUT = result, desc, physicalpts, vert, hori, ptype
# ----------------------------------------
code_block = CodeBlock(a=python_script) { a[0]; }
VARParameterNumbers = Output(code_block)
code_block_2 = CodeBlock(b=python_script) { b[1]; }
VARInfo = Output(code_block_2)
code_block_3 = CodeBlock(c=python_script) { c[2]; }
VARRefPoints = Output(code_block_3)
code_block_4 = CodeBlock(c=python_script) { c[3]; }
unit_types = UnitTypes("Length")  # graph input
displayUnitType = Custom[CW.UnitType.DisplayUnitType](VARunitType=unit_types)  # Retrieves the display unit type for a given unit type.
toDisplayUnit = Custom[CW.InternalUnit.ToDisplayUnit](VARval=code_block_4, VARdisplayUnitType=displayUnitType.VARdisplayUnitType)  # Converts a value from Revit's internal unit to a given display unit
VARVerticalSpacing = Output(toDisplayUnit)
code_block_5 = CodeBlock(c=python_script) { c[4]; }
unit_types_2 = UnitTypes("Length")  # graph input
displayUnitType_2 = Custom[CW.UnitType.DisplayUnitType](VARunitType=unit_types_2)
toDisplayUnit_2 = Custom[CW.InternalUnit.ToDisplayUnit](VARval=code_block_5, VARdisplayUnitType=displayUnitType_2.VARdisplayUnitType)
VARHorizontalSpacing = Output(toDisplayUnit_2)
code_block_6 = CodeBlock(c=python_script) { c[5]; }
VARPatternType = Output(code_block_6)
