# Dynamo custom node Advanced Elements Filter.dyf (Dynamo 2.13.1.3887)
# category: Synthesize.Automate.Select
# Advanced Elements Filter
# packages: Synthesize toolkit 12.6.3

VARIsTypeParameter = Input(VARIsTypeParameter: bool = false)
VARElements = Input(VARElements: var[]..[])
flatten = List.Flatten(list=VARElements)
turnIntoList = Custom[CW.TurnIntoList](VARunknownItem=flatten)  # package Synthesize toolkit; Turns an element (or a nested list) into a flat list
VARFilterByOtherParameters = Input(VARFilterByOtherParameters: bool = false)
VARParametersList = Input(VARParametersList: var[] = null)
trimWhitespace = String.TrimWhitespace(string=VARParametersList)
turnIntoList_2 = Custom[CW.TurnIntoList](VARunknownItem=trimWhitespace)
VARParameterValues = Input(VARParameterValues: var[] = null)
trimWhitespace_2 = String.TrimWhitespace(string=VARParameterValues)
turnIntoList_3 = Custom[CW.TurnIntoList](VARunknownItem=trimWhitespace_2)
VARRoundingIfNumbersFound = Input(VARRoundingIfNumbersFound: double = 0.001)
VARFilterModeFalseORTrueAND = Input(VARFilterModeFalseORTrueAND: bool = false)
python_script = Python(IN[0]=VARIsTypeParameter, IN[1]=turnIntoList, IN[2]=VARFilterByOtherParameters, IN[3]=turnIntoList_2, IN[4]=turnIntoList_3, IN[5]=VARRoundingIfNumbersFound, IN[6]=VARFilterModeFalseORTrueAND)  # IronPython2
# ---------- python_script.python (413 lines) ----------
# Created By Karam Baki : karam@aecedx.com
# Enable Python support and load DesignScript library
# IMPORTANT : ALL DYNAMO DESIGN SCRIPT NODES ARE AS (dg)
import clr
clr.AddReference('ProtoGeometry')
from Autodesk.DesignScript import Geometry as dg

# EXTENSION Enable ToDSType
clr.AddReference('RevitNodes')
import Revit
clr.ImportExtensions(Revit.Elements)

# Enable Revit Elements
from Revit.Elements import *

# EXTENSION Enable Geometry Conversion Methods
clr.ImportExtensions(Revit.GeometryConversion)

# Enable Revit API
clr.AddReference('RevitAPI')
from Autodesk.Revit.DB import *

# Enable DocumentManager and TransactionManager
clr.AddReference('RevitServices')
from RevitServices.Persistence import DocumentManager
from RevitServices.Transactions import TransactionManager

# Enable ICollection List Translate
clr.AddReference("System")
import System.Collections.Generic
from System.Collections.Generic import List

import re

dataEnteringNode = IN
# Use UnwrapElement(IN[0]) When Translating From Dynamo to Revit

isType = UnwrapElement(IN[0])
elems = UnwrapElement(IN[1])
filterbyparam = UnwrapElement(IN[2])
paramnamefilterlist = UnwrapElement(IN[3])
paramnamevaluelist = UnwrapElement(IN[4])
rounding = UnwrapElement(IN[5])
filtermode= UnwrapElement(IN[6])

paramnamevalue = []
for each in paramnamevaluelist:
	try:
		paramnamevalue.append(each.lower())
	except: paramnamevalue.append(each)

paramnamefilter = []

counter = 0
for each in paramnamefilterlist:
	if len(each) == 0:
		paramnamevalue.pop(counter)
	else:
		paramnamefilter.append(each)
	counter = counter + 1

# Choose The Current Document
doc = DocumentManager.Instance.CurrentDBDocument
uidoc = DocumentManager.Instance.CurrentUIApplication.ActiveUIDocument
uiapp = DocumentManager.Instance.CurrentUIApplication
app = uiapp.Application

finalelems = []
realelems = []
failedtoparsetypelems = []
tmporary = []

if isType == True:
	newelemes = []
	for each in elems:
		try:
			tmporary.append(each.GetTypeId())
			newelemes.append(each)
		except:
			pass
	elems = newelemes
	counter = 0
	for each in tmporary:
		elementtype = doc.GetElement(each)
		if elementtype != None:
			finalelems.append(doc.GetElement(each))
			realelems.append(elems[counter])
		else:
			failedtoparsetypelems.append(elems[counter])
		counter = counter + 1
else:
	for each in elems:
		try:
			tmporary.append(each.Id)
		except:
			tmporary.append([])
	counter = 0
	for each in tmporary:
		try:
			elementselection = doc.GetElement(each)
		except:
			elementselection = None
		if elementselection != None:
			finalelems.append(doc.GetElement(each))
			realelems.append(elems[counter])
		else:
			failedtoparsetypelems.append(elems[counter])
		counter = counter + 1

paramvalues = []
paramnames = []
paramtypes = []
paramstoragetype = []
acceptedelems = []
acceptedtypes = []

if int(DocumentManager.Instance.CurrentUIApplication.Application.VersionNumber) < 2021:
	oldrevit = True
else:
	oldrevit = False

counterelems = 0
for each in finalelems:
	currentrealelem = realelems[counterelems]
	counterelems = counterelems + 1
	eachparams = each.GetOrderedParameters()
	tmplisttypes = []
	tmpliststorage = []
	tmplistnames = []
	tmplistvalues = []
	status = []
	for pname in paramnamefilter:
		e = each.LookupParameter(pname)
		if e == None:
			continue
		if e.IsReadOnly:
			wanted_e_found = False
			multiParams = each.GetParameters(pname)
			if len(multiParams) > 1:
				for e in multiParams:
					if e.IsReadOnly == False:
						wanted_e_found = True
						break
				if wanted_e_found == False:
					e = multiParams[-1]
		if oldrevit:
			ptype = e.Definition.ParameterType
		else:
			ptype = LabelUtils.GetLabelForSpec(e.Definition.GetDataType())
		storagetype = str(e.StorageType)
		if storagetype == "Integer":
			pvalues = e.AsInteger()
			if oldrevit:
				unit_type = e.Definition.UnitType
				formatoptions = doc.GetUnits().GetFormatOptions(unit_type)
				dispunits = formatoptions.DisplayUnits
				converted = UnitUtils.ConvertFromInternalUnits(pvalues,dispunits)
				pvalues = converted
			else:
				unit_type = e.Definition.GetDataType()
				converted = UnitUtils.ConvertFromInternalUnits(pvalues,doc.GetUnits().GetFormatOptions(unit_type).GetUnitTypeId())
				pvalues = converted
		elif storagetype == "Double":
			pvalues = e.AsDouble()
			if oldrevit:
				unit_type = e.Definition.UnitType
				formatoptions = doc.GetUnits().GetFormatOptions(unit_type)
				dispunits = formatoptions.DisplayUnits
				converted = UnitUtils.ConvertFromInternalUnits(pvalues,dispunits)
				pvalues = converted
			else:
				unit_type = e.Definition.GetDataType()
				converted = UnitUtils.ConvertFromInternalUnits(pvalues,doc.GetUnits().GetFormatOptions(unit_type).GetUnitTypeId())
				pvalues = converted
		elif storagetype == "String":
			pvalues = e.AsString()
		elif storagetype == "ElementId":
			pvalues = doc.GetElement(e.AsElementId())
		else:
			pvalues = e.AsValueString()
		if str(ptype) == "Invalid":
			ptype = pname
		if str(ptype) == "Rafter Cut":
			try:
				pvalues = currentrealelem.EaveCuts
				eavecut = str(pvalues)
			except : pass
		counter = 0
		for eachitem in paramnamefilter:
			if filterbyparam == True and paramnamefilter[counter].lower() == pname.lower():
				if str(ptype) == "Rafter Cut":
					try:
						if eavecut == "PlumbCut":
							eavecut = "Plumb Cut"
						elif eavecut == "TwoCutPlumb":
							eavecut = "Two Cut - Plumb"
						elif eavecut == "TwoCutSquare":
							eavecut = "Two Cut - Square"
							
						if eavecut.lower() == paramnamevalue[counter]:
							status.append(True)
						else: status.append(False)
					except: status.append(False)
			
				elif str(ptype) == "FamilyType":
					try:
						fullname = e.AsValueString()
						if fullname.lower() == paramnamevalue[counter]:
							status.append(True)
						else: status.append(False)
					except: status.append(False)

				elif storagetype == "ElementId":
					try:
						tranvalue = pvalues.Name
						if tranvalue.lower() == paramnamevalue[counter]:
							status.append(True)
						else: status.append(False)
					except:
						if paramnamevalue[counter].lower() == "unconnected":			
							status.append(True)
						else:
							status.append(False)
					
				elif storagetype == "String":
					try:
						tranvalue = pvalues
						if paramnamevalue[counter].endswith("*"):
							if tranvalue.lower().startswith(paramnamevalue[counter][:-1]):
								status.append(True)
							else:
								status.append(False)
						elif paramnamevalue[counter].startswith("*"):
							if tranvalue.lower().endswith(paramnamevalue[counter][1:]):
								status.append(True)
							else:
								status.append(False)
						elif tranvalue.lower() == paramnamevalue[counter]:
							status.append(True)
						else: status.append(False)
					except: status.append(False)
					
				elif storagetype == "Integer":
					tranvalue = int(pvalues)
					try:
						if re.match(">=", paramnamevalue[counter]) or re.match("=>", paramnamevalue[counter]):
							paramnamevalueNEW = re.sub(">=", '',paramnamevalue[counter])
							paramnamevalueNEW = re.sub("=>", '',paramnamevalueNEW)
							if tranvalue >= int(paramnamevalueNEW):
								status.append(True)
							else: 
								status.append(False)
								
						elif re.match("<=", paramnamevalue[counter]) or re.match("=<", paramnamevalue[counter]):
							paramnamevalueNEW = re.sub("<=", '',paramnamevalue[counter])
							paramnamevalueNEW = re.sub("=<", '',paramnamevalueNEW)
							if tranvalue <= int(paramnamevalueNEW):
								status.append(True)
							else: 
								status.append(False)
								
						elif re.match(">", paramnamevalue[counter]):
							paramnamevalueNEW = re.sub(">", '',paramnamevalue[counter])
							if tranvalue > int(paramnamevalueNEW):
								status.append(True)
							else: 
								status.append(False)
							
						elif re.match("<", paramnamevalue[counter]):
							paramnamevalueNEW = re.sub("<", '',paramnamevalue[counter])
							if tranvalue < int(paramnamevalueNEW):
								status.append(True)
							else: 
								status.append(False)
							
						elif re.match("!=", paramnamevalue[counter]) or re.match("=!", paramnamevalue[counter]):
							paramnamevalueNEW = re.sub("!=", '',paramnamevalue[counter])
							paramnamevalueNEW = re.sub("=!", '',paramnamevalueNEW)
							if tranvalue != int(paramnamevalueNEW):
								status.append(True)
							else: 
								status.append(False)
								
						elif re.match("=", paramnamevalue[counter]) or re.match("==", paramnamevalue[counter]):
							paramnamevalueNEW = re.sub("=", '',paramnamevalue[counter])
							paramnamevalueNEW = re.sub("==", '',paramnamevalueNEW)
							if tranvalue == int(paramnamevalueNEW):
								status.append(True)
							else: 
								status.append(False)
								
						else:
							if tranvalue == int(paramnamevalue[counter]):
								status.append(True)
							else: 
								status.append(False)
					except: status.append(False)
				
				elif storagetype == "Double":
					tranvalue = float(pvalues)
					tranvalue = round(tranvalue/rounding)*rounding
					try:
						if re.match(">=", paramnamevalue[counter]) or re.match("=>", paramnamevalue[counter]):
							paramnamevalueNEW = re.sub(">=", '',paramnamevalue[counter])
							paramnamevalueNEW = re.sub("=>", '',paramnamevalueNEW)
							paramnameconverted = float(paramnamevalueNEW)
							if tranvalue >= round(paramnameconverted/rounding)*rounding:
								status.append(True)
							else: 
								status.append(False)
								
						elif re.match("<=", paramnamevalue[counter]) or re.match("=<", paramnamevalue[counter]):
							paramnamevalueNEW = re.sub("<=", '',paramnamevalue[counter])
							paramnamevalueNEW = re.sub("=<", '',paramnamevalueNEW)
							paramnameconverted = float(paramnamevalueNEW)
							if tranvalue <= round(paramnameconverted/rounding)*rounding:
								status.append(True)
							else: 
								status.append(False)
								
						elif re.match(">", paramnamevalue[counter]):
							paramnamevalueNEW = re.sub(">", '',paramnamevalue[counter])
							paramnameconverted = float(paramnamevalueNEW)
							if tranvalue > round(paramnameconverted/rounding)*rounding:
								status.append(True)
							else: 
								status.append(False)
							
						elif re.match("<", paramnamevalue[counter]):
							paramnamevalueNEW = re.sub("<", '',paramnamevalue[counter])
							paramnameconverted = float(paramnamevalueNEW)
							if tranvalue < round(paramnameconverted/rounding)*rounding:
								status.append(True)
							else: 
								status.append(False)
							
						elif re.match("!=", paramnamevalue[counter]) or re.match("=!", paramnamevalue[counter]):
							paramnamevalueNEW = re.sub("!=", '',paramnamevalue[counter])
							paramnamevalueNEW = re.sub("=!", '',paramnamevalueNEW)
							paramnameconverted = float(paramnamevalueNEW)
							if tranvalue != round(paramnameconverted/rounding)*rounding:
								status.append(True)
							else: 
								status.append(False)
								
						elif re.match("=", paramnamevalue[counter]) or re.match("==", paramnamevalue[counter]):
							paramnamevalueNEW = re.sub("=", '',paramnamevalue[counter])
							paramnamevalueNEW = re.sub("==", '',paramnamevalueNEW)
							paramnameconverted = float(paramnamevalueNEW)
							if tranvalue == round(paramnameconverted/rounding)*rounding:
								status.append(True)
							else: 
								status.append(False)
				
						else:
							paramnameconverted = float(paramnamevalue[counter])
							if tranvalue == round(paramnameconverted/rounding)*rounding:
								status.append(True)
							else: 
								status.append(False)
					except: status.append(False)
				else:
					try:
						tranvalue = pvalues.Name
						if tranvalue.lower() == paramnamevalue[counter]:
							status.append(True)
						else: status.append(False)
					except:
						try:
							tranvalue = str(pvalues)
							if tranvalue.lower() == paramnamevalue[counter]:
								status.append(True)
							else: status.append(False)
						except: status.append(False)
			counter = counter + 1
		tmplistvalues.append(pvalues)
		tmplistnames.append(pname)
		tmplisttypes.append(e)
		tmpliststorage.append(storagetype)
	if filtermode == False:
		if any(status) == True and filterbyparam == True:
			paramtypes.append(tmplisttypes)
			paramstoragetype.append(tmpliststorage)
			paramnames.append(tmplistnames)
			paramvalues.append(tmplistvalues)
			acceptedelems.append(currentrealelem)
			if isType == True:
				acceptedtypes.append(each)
	else:
		if all(status) == True and filterbyparam == True and len(status) == len(paramnamefilter):
			paramtypes.append(tmplisttypes)
			paramstoragetype.append(tmpliststorage)
			paramnames.append(tmplistnames)
			paramvalues.append(tmplistvalues)
			acceptedelems.append(currentrealelem)
			if isType == True:
				acceptedtypes.append(each)
	if any(status) == False and filterbyparam == False:
		paramtypes.append(tmplisttypes)
		paramstoragetype.append(tmpliststorage)
		paramnames.append(tmplistnames)
		paramvalues.append(tmplistvalues)
		acceptedelems.append(currentrealelem)
		if isType == True:
			acceptedtypes.append(each)
			
if isType == True:
	pass
else:
	acceptedtypes = "Is Type Is Not Activated"
	failedtoparsetypelems = "Is Type Is Not Activated"
# Assign your output to the OUT variable.
OUT = acceptedelems, acceptedtypes, failedtoparsetypelems, paramnames, paramtypes, paramvalues, paramstoragetype
# ----------------------------------------
code_block = CodeBlock(res=python_script) { res[0]; res[1]; res[2]; res[3]; res[4]; res[5]; res[6]; }
VARElements_2 = Output(code_block.out0)  # "VARElements"
VARTypesOfElementsIfIsTypeIsActivated = Output(code_block.out1)
VARFailedToParseTypesOfElementsIfIsTypeI = Output(code_block.out2)  # "VARFailedToParseTypesOfElementsIfIsTypeIsActivated"
VARParameterNames = Output(code_block.out3)
VARParameter = Output(code_block.out4)
VARParameterValues_2 = Output(code_block.out5)  # "VARParameterValues"
VARParameterStorageType = Output(code_block.out6)
