# Dynamo custom node Advanced Parameter Set With Translate.dyf (Dynamo 2.1.0.7500)
# category: Synthesize.Automate.Parameter
# Advanced Parameter Set With Translate

VARIsType = Input(VARIsType: var[]..[])
VARElements = Input(VARElements: var[]..[])
get_family_and_type_name_by = Custom[Get Family and Type Name By Family Instance](VARFamilyInstance=VARElements)  # Get Family and Type Name
scopeIf = Custom[CW.ScopeIf+](VARtest=VARIsType, VARtrue=get_family_and_type_name_by.VARElementTypes, VARfalse=VARElements)  # A (hopefully) more robust implementation of ScopeIf. Tests a single boolean and returns a value accordingly.
VARParameterToChange = Input(VARParameterToChange: var[]..[])
toLower = String.ToLower(str=VARParameterToChange)
trimWhitespace = String.TrimWhitespace(str=toLower)
code_block = CodeBlock { "*"; ""; }
contains = String.Contains(str=trimWhitespace, searchFor=code_block.out0)
VARParameterNames = Input(VARParameterNames: var[]..[])
toLower_2 = String.ToLower(str=VARParameterNames)
trimWhitespace_2 = String.TrimWhitespace(str=toLower_2)
replace = String.Replace(str=trimWhitespace, searchFor=code_block.out0, replaceWith=code_block.out1)
startsWith = String.StartsWith(str=trimWhitespace_2, searchFor=replace)
eq = trimWhitespace_2 == trimWhitespace
scopeIf_2 = Custom[CW.ScopeIf+](VARtest=contains, VARtrue=startsWith, VARfalse=eq)
anyTrue = Custom[CW.List.AnyTrue](VARseq=scopeIf_2)  # Returns true if any item in a list of booleans is true.
filterByBoolMask = List.FilterByBoolMask(list=scopeIf, mask=anyTrue)
VARParameters = Input(VARParameters: var[]..[])
filterByBoolMask_2 = List.FilterByBoolMask(list=VARParameters, mask=scopeIf_2)
filterByBoolMask_3 = List.FilterByBoolMask(list=filterByBoolMask_2.in, mask=anyTrue)
VARParameterValueToSet = Input(VARParameterValueToSet: var[]..[])
advanced_parameter_type = Custom[Advanced Parameter Type Translate](VARParameterToSet=VARParameterValueToSet, VARParameters=filterByBoolMask_3.in@L2)  # Advanced Parameter Type Translate
isNull = Object.IsNull(obj=advanced_parameter_type)
filterByBoolMask_4 = List.FilterByBoolMask(list=filterByBoolMask_3.in, mask=isNull)
filterByBoolMask_5 = List.FilterByBoolMask(list=advanced_parameter_type, mask=isNull)
advanced_parameter_set = Custom[Advanced Parameter Set](VARElements=filterByBoolMask.in, VARRevitParametersToSet=filterByBoolMask_4.out, VARTranslatedParameterValues=filterByBoolMask_5.out)  # Advanced Parameter Set
countTrue = List.CountTrue(list=advanced_parameter_set)
VARCount = Output(countTrue)
