# Dynamo custom node Advanced Parameter Set.dyf (Dynamo 2.1.0.7500)
# category: Synthesize.Automate.Select
# Advanced Parameter Set

VARElements = Input(VARElements: var[]..[])
VARRevitParametersToSet = Input(VARRevitParametersToSet: var[]..[])
VARTranslatedParameterValues = Input(VARTranslatedParameterValues: var[]..[])
python_script = Python(IN[0]=VARElements, IN[1]=VARRevitParametersToSet, IN[2]=VARTranslatedParameterValues)
# ---------- python_script.python (85 lines) ----------
# Created By Karam Baki : karam@aecedx.com
# Enable Python support and load DesignScript library
# IMPORTANT : ALL DYNAMO DESIGN SCRIPT NODES ARE AS (dg)
#import sys
#sys.path.append(r'C:\Program Files (x86)\IronPython 2.7\DLLs')
#sys.path.append(r'C:\Program Files (x86)\IronPython 2.7\Lib')

#import numbers

import clr
clr.AddReference('ProtoGeometry')
from Autodesk.DesignScript import Geometry as dg

clr.AddReference("RevitAPIUI")
from Autodesk.Revit.UI import TaskDialog

# EXTENSION Enable ToDSType
clr.AddReference('RevitNodes')
import Revit
clr.ImportExtensions(Revit.Elements)

# Enable Revit Elements
from Revit.Elements import *

# EXTENSION Enable Geometry Conversion Methods
clr.ImportExtensions(Revit.GeometryConversion)

# Enable Revit API
clr.AddReference('RevitAPI')
from Autodesk.Revit.DB import *

# Enable DocumentManager and TransactionManager
clr.AddReference('RevitServices')
from RevitServices.Persistence import DocumentManager
from RevitServices.Transactions import TransactionManager

# Enable ICollection List Translate
clr.AddReference("System")
import System.Collections.Generic
from System.Collections.Generic import List

# Choose The Current Document
doc = DocumentManager.Instance.CurrentDBDocument
uidoc = DocumentManager.Instance.CurrentUIApplication.ActiveUIDocument
uiapp = DocumentManager.Instance.CurrentUIApplication
app = uiapp.Application

#factor = UnitUtils.ConvertToInternalUnits(1,doc.GetUnits().GetFormatOptions(UnitType.UT_Length).DisplayUnits)

def tolist(obj1):
	if hasattr(obj1,'__iter__'): return obj1
	else: return [obj1]

#The inputs to this node will be stored as a list in the IN variable.
dataEnteringNode = IN
elems = UnwrapElement(IN[0])
params = tolist(IN[1])
paramsvalues = IN[2]

result = []

TransactionManager.Instance.EnsureInTransaction(doc)
counter = 0
for each in elems:
	currentparams = params[counter]
	currentvalues = paramsvalues[counter]
	counter = counter + 1
	innercount = 0
	for e in currentparams:
		wantedval = currentvalues[innercount]
		innercount += 1
		if e.IsReadOnly == False:
			try:
				result.append(e.Set(wantedval))
			except:
				pass
TransactionManager.Instance.TransactionTaskDone()
	
if len(result) == 0:
	msg = "One or more parameters were not found"
	title = "Synthesize toolkit"
	alert = TaskDialog
	OUT = alert.Show(title, msg)

OUT = result
# ----------------------------------------
VAROutput = Output(python_script)
