# Dynamo custom node Advanced Parameter Type Translate.dyf (Dynamo 2.13.1.3887)
# category: Synthesize.Automate.Select
# Advanced Parameter Type Translate

VARParameterToSet = Input(VARParameterToSet: var[]..[])
VARParameters = Input(VARParameters: var[]..[])
python_script = Python(IN[0]=VARParameterToSet, IN[1]=VARParameters)  # IronPython2
# ---------- python_script.python (200 lines) ----------
# Created By Karam Baki : karam@aecedx.com
# Enable Python support and load DesignScript library
# IMPORTANT : ALL DYNAMO DESIGN SCRIPT NODES ARE AS (dg)
import clr
clr.AddReference('ProtoGeometry')
from Autodesk.DesignScript import Geometry as dg

# EXTENSION Enable ToDSType
clr.AddReference('RevitNodes')
import Revit
clr.ImportExtensions(Revit.Elements)

# Enable Revit Elements
from Revit.Elements import *

# EXTENSION Enable Geometry Conversion Methods
clr.ImportExtensions(Revit.GeometryConversion)

# Enable Revit API
clr.AddReference('RevitAPI')
from Autodesk.Revit.DB import *

# Enable DocumentManager and TransactionManager
clr.AddReference('RevitServices')
from RevitServices.Persistence import DocumentManager
from RevitServices.Transactions import TransactionManager

# Enable ICollection List Translate
clr.AddReference("System")
import System.Collections.Generic
from System.Collections.Generic import List

# Choose The Current Document
doc = DocumentManager.Instance.CurrentDBDocument
uidoc = DocumentManager.Instance.CurrentUIApplication.ActiveUIDocument
uiapp = DocumentManager.Instance.CurrentUIApplication
app = uiapp.Application


doc = DocumentManager.Instance.CurrentDBDocument

if int(DocumentManager.Instance.CurrentUIApplication.Application.VersionNumber) < 2021:
	oldrevit = True
else:
	oldrevit = False

#The inputs to this node will be stored as a list in the IN variable.
data = UnwrapElement(IN[0]).strip()
parameters = UnwrapElement(IN[1])

result = []

for par in parameters:
	if oldrevit:
		a = str(par.Definition.ParameterType)
	else:
		a = LabelUtils.GetLabelForSpec(par.Definition.GetDataType())
	if a == "Invalid":
		if "level" in par.Definition.Name.lower():
			a = "Level"
	if a == "Wrapping at Ends" or a == "Wrapping at Inserts" :
		status = []
		if data.lower() == "none" or data.lower() == "do not wrap":
			wraptype = 0
			result.append(wraptype)
			status.append(wraptype)
		elif data.lower() == "exterior":
			wraptype = 1
			result.append(wraptype)
			status.append(wraptype)
		elif data.lower() == "interior":
			wraptype = 2
			result.append(wraptype)
			status.append(wraptype)
		elif data.lower() == "both":
			wraptype = 3
			result.append(wraptype)
			status.append(wraptype)
		if len(status) == 0:
			result.append(None)

	elif a == "Rafter Cut":
		status = []
		if data.lower() == "plumb cut":
			raftype = EaveCutterType.PlumbCut.value__
			result.append(raftype)
			status.append(raftype)
		elif data.lower() == "two cut - plumb":
			raftype = EaveCutterType.TwoCutPlumb.value__
			result.append(raftype)
			status.append(raftype)
		elif data.lower() == "two cut - square":
			raftype = EaveCutterType.TwoCutSquare.value__
			result.append(raftype)
			status.append(raftype)
		if len(status) == 0:
			result.append(None)
			
	elif a == "Material":
		status = []
		allData = FilteredElementCollector(doc).OfClass(Material).ToElements()
		for each in allData:
			if each.Name.lower() == data.lower():
				eachid = each.Id
				result.append(eachid)
				status.append(eachid)
				break
			else: continue
		if len(status) == 0:
			result.append(None)
			
	elif a == "Phase Created" or a == "Phase Demolished":
		status = []
		allData = FilteredElementCollector(doc).OfClass(Phase).ToElements()
		for each in allData:
			if each.Name.lower() == data.lower():
				eachid = each.Id
				result.append(eachid)
				status.append(eachid)
				break
			else: continue
		if len(status) == 0:
			result.append(None)
			
	elif a == "Level":
		status = []
		allData = FilteredElementCollector(doc).OfClass(Level).ToElements()
		for each in allData:
			if each.Name.lower() == data.lower():
				eachid = each.Id
				result.append(eachid)
				status.append(eachid)
				break
			else: continue
		if len(status) == 0:
			result.append(None)
			
	elif a == "FamilyType":
		status = []
		try:
			datasplit = data.split(":")
			familyname = datasplit[0].strip()
			typename = datasplit[1].strip()
			familytypes = Revit.Elements.FamilyType.ByFamilyNameAndTypeName(familyname,typename)
			familytypesid = familytypes.Id
			result.append(familytypesid)
			status.append(familytypesid)
		except:
			pass
		if len(status) == 0:
			result.append(None)
	
	elif "Text" in a:
		status = []
		try:
			result.append(str(data))
			status.append(str(data))
		except:
			pass
		if len(status) == 0:
			result.append(None)

	elif "YesNo" in a:
		status = []
		try:
			ndata = int(data)
			result.append(ndata)
			status.append(ndata)
		except:
			pass
		if len(status) == 0:
			result.append(None)
			
	elif "Integer" in a:
		try:
			ndata = int(data)
			result.append(ndata)
		except:
			result.append(ndata)
			
	else:
		try:
			if oldrevit:
				unit_type = par.Definition.UnitType
				formatoptions = doc.GetUnits().GetFormatOptions(unit_type)
				dispunits = formatoptions.DisplayUnits
				ndata = float(data)
				converted = UnitUtils.ConvertToInternalUnits(ndata,dispunits)
				ndata = converted
				result.append(ndata)
			else:
				unit_type = par.Definition.GetDataType()
				ndata = float(data)
				converted = UnitUtils.ConvertToInternalUnits(ndata,doc.GetUnits().GetFormatOptions(unit_type).GetUnitTypeId())
				ndata = converted
				result.append(ndata)
		except:
			result.append(data)

OUT = result
# ----------------------------------------
VARTranslatedParameters = Output(python_script)
