# Dynamo custom node Alert Popup With Wait.dyf (Dynamo 2.1.0.7500)
# category: Synthesize.Misc
# Popup a message dialog in Revit

VARMessage = Input(VARMessage: var[]..[])
VARWaitfor = Input(VARWaitfor: var[]..[])
python_script = Python(IN[0]=VARMessage, IN[1]=VARWaitfor)
# ---------- python_script.python (14 lines) ----------
import clr
clr.AddReference("RevitAPIUI")
from Autodesk.Revit.UI import TaskDialog

msg = IN[0]
waitfor = IN[1]

title = "AECedx - Karam"
alert = TaskDialog

if msg == None or len(msg) == 0:
	OUT = "No Message To Show"
else:
	OUT = alert.Show(title, msg)
# ----------------------------------------
VARvoid = Output(python_script)
