# Dynamo custom node All Surfaces or Surface Filtering.dyf (Dynamo 2.1.0.7500)
# category: Synthesize.Automate.Surface
# All Surfaces or Surface Filtering

VARFetchWholeBody = Input(VARFetchWholeBody: bool = false)
VARBruteForceGeometryReferencesWillNotWo = Input(VARBruteForceGeometryReferencesWillNotWork: bool = false)
python_script = Python(IN[0]=VARFetchWholeBody, IN[1]=VARBruteForceGeometryReferencesWillNotWo)
# ---------- python_script.python (10 lines) ----------
import clr
clr.AddReference('ProtoGeometry')
from Autodesk.DesignScript.Geometry import *
#The inputs to this node will be stored as a list in the IN variables.
dataEnteringNode = IN

if IN[0] == False and IN[1] == True:
	OUT = False
else:
	OUT = IN[1]
# ----------------------------------------
VARSurfaces = Input(VARSurfaces: var[]..[])
flatten = List.Flatten(list=VARSurfaces)
empty = List.Empty()
scopeIf = Custom[CW.ScopeIf+](VARtest=VARFetchWholeBody, VARtrue=flatten, VARfalse=empty)  # A (hopefully) more robust implementation of ScopeIf. Tests a single boolean and returns a value accordingly.
fromDynamoSurface = Custom[CW.Element.FromDynamoSurface](VARDynamoSurface=scopeIf)  # Returns the underlying Revit element of a given face
flatten_2 = List.Flatten(list=fromDynamoSurface)
uniqueItems = List.UniqueItems(list=flatten_2)
empty_2 = List.Empty()
scopeIf_2 = Custom[CW.ScopeIf+](VARtest=VARBruteForceGeometryReferencesWillNotWo, VARtrue=uniqueItems, VARfalse=empty_2)
element_geometry_fast = Custom[Element.Geometry Fast](VARElements=scopeIf_2)  # Element.Geometry Fast
explode = Geometry.Explode(geometry=element_geometry_fast)
flatten_3 = List.Flatten(list=explode)
empty_3 = List.Empty()
scopeIf_3 = Custom[CW.ScopeIf+](VARtest=VARBruteForceGeometryReferencesWillNotWo, VARtrue=empty_3, VARfalse=uniqueItems)
scopeIf_4 = Custom[CW.ScopeIf+](VARtest=VARFetchWholeBody, VARtrue=scopeIf_3, VARfalse=empty_3)
python_script_2 = Python(IN[0]=scopeIf_4)
# ---------- python_script_2.python (112 lines) ----------
# Enable Python support and load DesignScript library
# IMPORTANT : ALL DYNAMO DESIGN SCRIPT NODES ARE AS (dg)
import clr
clr.AddReference('ProtoGeometry')
from Autodesk.DesignScript import Geometry as dg

# EXTENSION Enable ToDSType
clr.AddReference('RevitNodes')
import Revit
clr.ImportExtensions(Revit.Elements)

# Enable Revit Elements
from Revit.Elements import *

# EXTENSION Enable Geometry Conversion Methods
clr.ImportExtensions(Revit.GeometryConversion)

# Enable Revit API
clr.AddReference('RevitAPI')
from Autodesk.Revit.DB import *

# Enable DocumentManager and TransactionManager
clr.AddReference('RevitServices')
from RevitServices.Persistence import DocumentManager
from RevitServices.Transactions import TransactionManager

# Enable ICollection List Translate
clr.AddReference("System")
import System.Collections.Generic
from System.Collections.Generic import List

# Choose The Current Document
doc = DocumentManager.Instance.CurrentDBDocument
uidoc = DocumentManager.Instance.CurrentUIApplication.ActiveUIDocument
uiapp = DocumentManager.Instance.CurrentUIApplication
app = uiapp.Application

def tolist(obj1):
	if hasattr(obj1,'__iter__'): return obj1
	else: return [obj1]

def flatten(x):
    result = []
    for el in x:
        if hasattr(el, "__iter__") and not isinstance(el, basestring):
            result.extend(flatten(el))
        else:
            result.append(el)
    return result

def analgeom(elem):
	opt1 = Options()
	opt1.ComputeReferences = True
	result = []
	surfaces = []
	try:
		breakstatus = False
		geoms = elem.get_Geometry(opt1)
		extracted = []
		for e in geoms:
			if e.ToString() != "Autodesk.Revit.DB.GeometryInstance":
				try:
					extracted.append(e)
				except:
					pass
			elif e.ToString() == "Autodesk.Revit.DB.Solid":
				extracted.append(e)
		if len(extracted) == 0:
			breakstatus = True
		else:
			extracted = flatten(extracted)
			geoms = extracted
		if breakstatus == False:
			for e in geoms:
				if e.ToString() == "Autodesk.Revit.DB.Solid":
					faces = e.Faces
					for f in faces:
						try:
							surfaces.append(f.ToProtoType())
							result.append(f.Reference)
						except:
							pass
		else:
			dumped = []
			for e in geoms:
				if e.ToString() == "Autodesk.Revit.DB.GeometryInstance":
					dumped.append(e.GetSymbolGeometry())
			geoms = flatten(dumped)
			for e in geoms:
				if e.ToString() == "Autodesk.Revit.DB.Solid":
					faces = e.Faces
					for f in faces:
						try:
							surfaces.append(f.ToProtoType())
							result.append(f.Reference)
						except:
							pass
		return result,surfaces
	except:
		return None,None

if IN[0] == None or IN[0] == []:
	OUT = []
else:
	elems=UnwrapElement(flatten(tolist(IN[0])))
	result = []
	surfaces = []
	for e in elems:
		analOP = analgeom(e)
		result.append(analOP[0])
		surfaces.append(analOP[1])
	OUT = result,surfaces
# ----------------------------------------
code_block = CodeBlock(a=python_script_2) { a[0]; a[1]; }
flatten_4 = List.Flatten(list=code_block.out1)
VAROrienataion = Input(VAROrienataion: int = 4)
surface_orientation_filter = Custom[Surface Orientation Filter](VARSurfaces=flatten_4, VAROrienataion=VAROrienataion)  # Face Filter
scopeIf_5 = Custom[CW.ScopeIf+](VARtest=VARFetchWholeBody, VARtrue=surface_orientation_filter.VARSurfaces, VARfalse=flatten)
scopeIf_6 = Custom[CW.ScopeIf+](VARtest=python_script, VARtrue=flatten_3, VARfalse=scopeIf_5)
surface_orientation_filter_2 = Custom[Surface Orientation Filter](VARSurfaces=scopeIf_6, VAROrienataion=VAROrienataion)
VARDynamoFace = Output(surface_orientation_filter_2.VARSurfaces)
python_script_3 = Python(IN[0]=VARFetchWholeBody, IN[1]=VARBruteForceGeometryReferencesWillNotWo)  # same code as python_script
empty_4 = List.Empty()
flatten_5 = List.Flatten(list=code_block.out0)
filterByBoolMask = List.FilterByBoolMask(list=flatten_5, mask=surface_orientation_filter.VARBool)
empty_5 = List.Empty()
scopeIf_7 = Custom[CW.ScopeIf+](VARtest=VARFetchWholeBody, VARtrue=empty_5, VARfalse=flatten)
fromDynamoSurface_2 = Custom[CW.RevitFaceReference.FromDynamoSurface](VARDynamoSurface=scopeIf_7)  # Returns the underlying Revit face reference of a given surface
scopeIf_8 = Custom[CW.ScopeIf+](VARtest=VARFetchWholeBody, VARtrue=filterByBoolMask.in, VARfalse=fromDynamoSurface_2)
scopeIf_9 = Custom[CW.ScopeIf+](VARtest=python_script_3, VARtrue=empty_4, VARfalse=scopeIf_8)
filterByBoolMask_2 = List.FilterByBoolMask(list=scopeIf_9, mask=surface_orientation_filter_2.VARBool)
VARRevitFaceReference = Output(filterByBoolMask_2.in)
