# Dynamo custom node Auto Build Intersecting Surfaces On Surfaces.dyf (Dynamo 2.1.0.7500)
# category: Synthesize.Automate.Surface
# Auto Build Intersecting Surfaces On Surfaces

VARSurfaces = Input(VARSurfaces: var[]..[])
VARSplittingLines = Input(VARSplittingLines: var[]..[])
flatten = List.Flatten(list=VARSplittingLines)
VARSplitterThickness = Input(VARSplitterThickness: double = 0.1)
VARDetectionTollerance = Input(VARDetectionTollerance: double = 0.5)
VARPointsDistancing = Input(VARPointsDistancing: double = 0.5)
VARSplitExtendDistance = Input(VARSplitExtendDistance: double = 1)
VARPullOrNot = Input(VARPullOrNot: bool = false)
python_script = Python(IN[0]=flatten, IN[1]=VARSurfaces, IN[2]=VARSplitterThickness, IN[3]=VARDetectionTollerance, IN[4]=VARPointsDistancing, IN[5]=VARSplitExtendDistance, IN[6]=VARPullOrNot)
# ---------- python_script.python (108 lines) ----------
# Enable Python support and load DesignScript library
# IMPORTANT : ALL DYNAMO DESIGN SCRIPT NODES ARE AS (dg)
import clr
clr.AddReference('ProtoGeometry')
from Autodesk.DesignScript import Geometry as dg

# EXTENSION Enable ToDSType
clr.AddReference('RevitNodes')
import Revit
clr.ImportExtensions(Revit.Elements)

# Enable Revit Elements
from Revit.Elements import *

# EXTENSION Enable Geometry Conversion Methods
clr.ImportExtensions(Revit.GeometryConversion)

# Enable Revit API
clr.AddReference('RevitAPI')
from Autodesk.Revit.DB import *

# Enable DocumentManager and TransactionManager
clr.AddReference('RevitServices')
from RevitServices.Persistence import DocumentManager
from RevitServices.Transactions import TransactionManager

# Enable ICollection List Translate
clr.AddReference("System")
import System.Collections.Generic
from System.Collections.Generic import List

dataEnteringNode = IN
# Use UnwrapElement(IN[0]) When Translating From Dynamo to Revit
stuff = UnwrapElement(IN[0])
surfs = UnwrapElement(IN[1])
long = IN[2]

#TO SET UP EXTERNALLY
distance = IN[3]
pointsdis = IN[4]
extend = IN[5]
pullornot = IN[6]

# Choose The Current Document
doc = DocumentManager.Instance.CurrentDBDocument
uidoc = DocumentManager.Instance.CurrentUIApplication.ActiveUIDocument
uiapp = DocumentManager.Instance.CurrentUIApplication
app = uiapp.Application

def normcurve(pulled,pointsdis):
	stp = pulled.StartPoint
	enp = pulled.EndPoint
	lp = dg.Line.ByStartPointEndPoint(stp,enp).Length
	if round(pulled.Length,2) == round(lp,2):
		return pulled
	length = round(pulled.Length/pointsdis)
	if length < 4:
		length = 4
	a = range(0,int(length))
	points = []
	amin, amax = min(a), max(a)
	for val in a:
		item = float(val-amin) / float(amax-amin)
		points.append(dg.Curve.PointAtParameter(pulled,item))
	curve = dg.NurbsCurve.ByControlPoints(points)
	return curve

# Create Empty List
result = []
pts = []
srfs = []
for each in stuff:
	try:
		point = dg.Curve.PointAtParameter(each,0.5)
		for e in surfs:
			dist = dg.Geometry.DistanceTo(e,point)
			doesint = False
			if dist <= distance:
				doesint = True
			if doesint == True:
				each = normcurve(each,pointsdis)
				if pullornot:
					try:
						pulled = dg.Curve.PullOntoSurface(each,e)
						pulled = normcurve(pulled,pointsdis)
					except:
						pulled = each
				else:
					pulled = each
				try:
					pulled = dg.Curve.ExtendStart(pulled,extend)
					pulled = dg.Curve.ExtendEnd(pulled,extend)
				except:
					pass
				norm = dg.Surface.NormalAtPoint(e, point)
				line = dg.Line.ByStartPointDirectionLength(point,norm,long)
				line = dg.Curve.ExtendStart(line,long)
				try:
					other = dg.Curve.SweepAsSurface(line,pulled)
				except:
					other = dg.Surface.BySweep(line,pulled)
				pts.append(e)
				srfs.append(other)
	except:
		pass

# Assign your output to the OUT variable.
OUT = pts, srfs
# ----------------------------------------
transpose = List.Transpose(lists=python_script)
firstItem = List.FirstItem()  # unwired: list
groupByFunction = List.GroupByFunction(list=transpose, func=firstItem)
flatten_2 = List.Flatten(list=groupByFunction@L3)
uniqueItems = List.UniqueItems(list=flatten_2@L2)
firstItem_2 = List.FirstItem(list=uniqueItems@L2)
removeListFromList = Custom[RH.RemoveListFromList](VARListA=VARSurfaces, VARListB=firstItem_2)  # This node essentially "subtracts" the contents of List B from List A to produce a new list with the unique items.
code_block = CodeBlock { 1; }
dropItems = List.DropItems(list=uniqueItems@L2, amount=code_block)
as_geometry_splitbytools = Custom[AS.[&] Geometry.SplitByTools](VARgeometry=firstItem_2, VARtools=dropItems)  # Split one piece of geometry (other than a polysurface) by multiple tools
create = List.Create(item0=removeListFromList, item1=as_geometry_splitbytools)
code_block_2 = CodeBlock { false; }
clean = List.Clean(list=create, preserveIndices=code_block_2)
flatten_3 = List.Flatten(list=clean)
VARSurfaces_2 = Output(flatten_3)  # "VARSurfaces"
