# Dynamo custom node Auto Element Parameters Associate.dyf (Dynamo 2.1.0.7500)
# category: Synthesize.Automate.Family
# Auto Element Parameters Associate

VARElements = Input(VARElements: var[]..[])
VARParametertoAssociate = Input(VARParametertoAssociate: var[]..[])
VARNewParametersPrefix = Input(VARNewParametersPrefix: string = "")
VARBuiltInParameterGroupString = Input(VARBuiltInParameterGroupString: var[]..[])
translate_builtin_parameter = Custom[Translate BuiltIn Parameter Group](VARBuiltInParameterGroupString=VARBuiltInParameterGroupString)  # Translate BuiltIn Parameter Group
VARNewParameterAsInstance = Input(VARNewParameterAsInstance: bool = true)
VARSortParameters = Input(VARSortParameters: bool = true)
VARAvoidConflicts = Input(VARAvoidConflicts: bool = false)
python_script = Python(IN[0]=VARElements, IN[1]=VARParametertoAssociate, IN[2]=VARNewParametersPrefix, IN[3]=translate_builtin_parameter, IN[4]=VARNewParameterAsInstance, IN[5]=VARSortParameters, IN[6]=VARAvoidConflicts)
# ---------- python_script.python (199 lines) ----------
# Proudly created by Karam Baki: karam@aecedx.com

# Import crl
import clr

# Enable Revit API
clr.AddReference('RevitAPI')
from Autodesk.Revit.DB import *

# Enable DocumentManager and TransactionManager
clr.AddReference('RevitServices')
from RevitServices.Persistence import DocumentManager
from RevitServices.Transactions import TransactionManager

# Import os
clr.AddReference("System")
import System
import sys
pf_path = System.Environment.GetFolderPath(System.Environment.SpecialFolder.ProgramFilesX86)
sys.path.append('%s\IronPython 2.7\Lib' %pf_path)
import os

clr.AddReference("RevitAPIUI")
from Autodesk.Revit.UI import TaskDialog

def tolist(obj1):
	if hasattr(obj1,'__iter__'): return obj1
	else: return [obj1]

# Get ElementId or Value String
def simplebestparamvalue(famdoc,famtype,famparam):
	if famdoc == None and famtype == None:
		storagetype = str(famparam.StorageType)
		try:
			if storagetype == "Integer":
				ParamValueString = famparam.AsInteger()
			elif storagetype == "Double":
				ParamValueString = famparam.AsDouble()
			elif storagetype == "String":
				ParamValueString = famparam.AsString()
			elif storagetype == "ElementId":
				ParamValueString = famparam.AsElementId()
			else:
				ParamValueString = famparam.AsValueString()
		except:
			ParamValueString = famparam.AsValueString()
	else:
		storagetype = str(famparam.StorageType)
		try:
			if storagetype == "Integer":
				ParamValueString = famtype.AsInteger(famparam)
			elif storagetype == "Double":
				ParamValueString = famtype.AsDouble(famparam)
			elif storagetype == "String":
				ParamValueString = famtype.AsString(famparam)
			elif storagetype == "ElementId":
				ParamValueString = famtype.AsElementId(famparam)
			else:
				ParamValueString = famtype.AsValueString(famparam)
		except:
			ParamValueString = famtype.AsValueString(famparam)
	return ParamValueString

# Get/Create Wanted Family Type
def getfamtype(famdoc,famtypename = None):
	alltypes = famdoc.FamilyManager.Types
	if len(list(alltypes)) == 1 or famtypename == None:
		famtype = famdoc.FamilyManager.CurrentType
	elif len(list(alltypes)) == 0 or famtypename == None:
		famtype = famdoc.FamilyManager.NewType(famtypename)
		famdoc.FamilyManager.CurrentType = famtype
	else:
		for t in alltypes:
			if t.Name == famtypename:
				famdoc.FamilyManager.CurrentType = t
				famtype = t
				break
	return famtype

def assop(doc,sourceinstance,paramtoass,prefix,pgroup,isinstance,count,allfamparams,avoidconflict):
	try:
		if hasattr(sourceinstance,'__iter__'):
			ismulti = True
		else:
			ismulti = False
		if ismulti:
			status = []
			counts = []
			multicounter = 0
			for s in sourceinstance:
				allparams = list(s.GetOrderedParameters())
				parfound = False
				for param in allparams:
					pname = param.Definition.Name
					if pname.lower() == paramtoass.lower():
						parfound = True
						break
				if parfound:
					if multicounter == 0:
						val = simplebestparamvalue(None,None,param)
						cur_type = getfamtype(doc,doc.PathName.split("\\")[-1].split(".rfa")[0])
						found = False
						try:
							famparam = doc.FamilyManager.AddParameter(prefix + pname + " " + str(count),pgroup,param.Definition.ParameterType,isinstance)
							found = True
						except:
							minicount = 0
							if avoidconflict and minicount < len(allfamparams):
								conflict = True
								while conflict:
									try:
										count += 1
										famparam = doc.FamilyManager.AddParameter(prefix + pname + " " + str(count),pgroup,param.Definition.ParameterType,isinstance)
										conflict = False
										found = True
									except:
										minicount += 1
							else:
								for famparam in allfamparams:
									fpname = famparam.Definition.Name
									if fpname.lower() == prefix.lower() + paramtoass.lower() + " " + str(count):
										found = True
										break
					if found:
						if multicounter == 0:
							doc.FamilyManager.Set(famparam,val)
						doc.FamilyManager.AssociateElementParameterToFamilyParameter(param,famparam)
						multicounter += 1
					status.append(True)
				else:
					status.append(False)
			status = any(status)
			return status,count
		else:
			allparams = list(sourceinstance.GetOrderedParameters())
			parfound = False
			for param in allparams:
				pname = param.Definition.Name
				if pname.lower() == paramtoass.lower():
					parfound = True
					break
			if parfound:
				val = simplebestparamvalue(None,None,param)
				cur_type = getfamtype(doc,doc.PathName.split("\\")[-1].split(".rfa")[0])
				found = False
				try:
					famparam = doc.FamilyManager.AddParameter(prefix + pname + " " + str(count),pgroup,param.Definition.ParameterType,isinstance)
					found = True
				except:
					minicount = 0
					if avoidconflict and minicount < len(allfamparams):
						conflict = True
						while conflict:
							try:
								count += 1
								famparam = doc.FamilyManager.AddParameter(prefix + pname + " " + str(count),pgroup,param.Definition.ParameterType,isinstance)
								conflict = False
								found = True
							except:
								minicount += 1
					else:
						for famparam in allfamparams:
							fpname = famparam.Definition.Name
							if fpname.lower() == prefix.lower() + paramtoass.lower() + " " + str(count):
								found = True
								break
				if found:
					doc.FamilyManager.Set(famparam,val)
					doc.FamilyManager.AssociateElementParameterToFamilyParameter(param,famparam)
				return True,count
			else:
				return False,count
	except:
		return False,count
	
# Initial Family Instance Info
sourceinstance = UnwrapElement(tolist(IN[0]))
paramtoass = IN[1]
prefix = IN[2]
pgroup = UnwrapElement(IN[3])
isinstance = IN[4]
sortparams = IN[5]
avoidconflict = IN[6]

# Project Document and UI
doc = DocumentManager.Instance.CurrentDBDocument

TransactionManager.Instance.EnsureInTransaction(doc)
allfamparams = doc.FamilyManager.GetParameters()
count = 1
for s in sourceinstance:
	assme = assop(doc,s,paramtoass,prefix,pgroup,isinstance,count,allfamparams,avoidconflict)
	if assme[0]:
		count = assme[1] + 1
if sortparams:
	doc.FamilyManager.SortParameters(ParametersOrder.Ascending)
TransactionManager.Instance.TransactionTaskDone()
		
OUT = "Done"
# ----------------------------------------
VAROutput = Output(python_script)
