# Dynamo custom node Auto FBX Proxy.dyf (Dynamo 2.1.0.7500)
# category: Synthesize.Automate.Export
# Auto FBX Proxy

VARExportFolderPath = Input(VARExportFolderPath: var[]..[])
VARprefix = Input(VARprefix: var[]..[])
VARViewtoExport = Input(VARViewtoExport: var[]..[])
VARProxyFamily = Input(VARProxyFamily: var[]..[])
VAR1MainFamilies2SharedFamilies3MainWith = Input(VAR1MainFamilies2SharedFamilies3MainWithItsSharedFamilies: var[]..[])
code_block = CodeBlock { 1; }
eq = VAR1MainFamilies2SharedFamilies3MainWith == code_block
VARElements = Input(VARElements: var[]..[])
subComponents = Custom[CW.FamilyInstance.SubComponents](VARfamilyInstance=VARElements)  # Retrieves all subcomponents of a given family instance
python_empty_2_null = Custom[Python Empty 2 Null](VARIN=subComponents)  # Python Null 2 Empty
isNull = Object.IsNull(obj=python_empty_2_null)
code_block_2 = CodeBlock { 2; }
normalizeDepth = List.NormalizeDepth(list=isNull, rank=code_block_2)
anyTrue = Custom[CW.List.AnyTrue](VARseq=normalizeDepth)  # Returns true if any item in a list of booleans is true.
filterByBoolMask = List.FilterByBoolMask(list=VARElements, mask=anyTrue)

# group: NO SHARED INSIDE
watch = Watch(filterByBoolMask.in)

# group: CONTAINS THE SHARED
watch_2 = Watch(filterByBoolMask.out)

create = List.Create(item0=watch, item1=watch_2)
code_block_3 = CodeBlock { false; }
clean = List.Clean(list=create, preserveIndices=code_block_3)
flatten = List.Flatten(list=clean)
empty = List.Empty()
scopeIf = Custom[CW.ScopeIf+](VARtest=eq, VARtrue=flatten, VARfalse=empty)  # A (hopefully) more robust implementation of ScopeIf. Tests a single boolean and returns a value accordingly.
chop = List.Chop(list=scopeIf, lengths=code_block)
code_block_4 = CodeBlock { 2; }
eq_2 = VAR1MainFamilies2SharedFamilies3MainWith == code_block_4
normalizeDepth_2 = List.NormalizeDepth(list=python_empty_2_null, rank=code_block_2)
filterByBoolMask_2 = List.FilterByBoolMask(list=normalizeDepth_2, mask=anyTrue)

# group: THE SHARED
watch_3 = Watch(filterByBoolMask_2.out)
python_empty_2_null_2 = Custom[Python Empty 2 Null](VARIN=watch_3)
rank = List.Rank(list=python_empty_2_null_2)
normalizeDepth_3 = List.NormalizeDepth(list=python_empty_2_null_2, rank=rank)

empty_2 = List.Empty()
scopeIf_2 = Custom[CW.ScopeIf+](VARtest=eq_2, VARtrue=normalizeDepth_3, VARfalse=empty_2)
code_block_5 = CodeBlock { 3; }
eq_3 = VAR1MainFamilies2SharedFamilies3MainWith == code_block_5
join = List.Join()  # unwired: list0, list1
code_block_6 = CodeBlock { 1; }
chop_2 = List.Chop(list=watch_2, lengths=code_block_6)
combine = List.Combine(comb=join, list1=chop_2, list2=normalizeDepth_3)
python_script = Python(IN[0]=watch, IN[1]=combine)
# ---------- python_script.python (22 lines) ----------
import clr
clr.AddReference('ProtoGeometry')
from Autodesk.DesignScript.Geometry import *
#The inputs to this node will be stored as a list in the IN variables.
dataEnteringNode = IN

def tolist(obj1):
	if hasattr(obj1,'__iter__'): return obj1
	else: return [obj1]

list1 = tolist(IN[0])
list2 = tolist(IN[1])

all = []

for e in list1:
	all.append(e)
	
for e in list2:
	all.append(e)
#Assign your output to the OUT variable.
OUT = all
# ----------------------------------------
empty_3 = List.Empty()
scopeIf_3 = Custom[CW.ScopeIf+](VARtest=eq_3, VARtrue=python_script, VARfalse=empty_3)
python_script_2 = Python(IN[0]=chop, IN[1]=scopeIf_2, IN[2]=scopeIf_3, IN[3]=VAR1MainFamilies2SharedFamilies3MainWith)
# ---------- python_script_2.python (19 lines) ----------
import clr
clr.AddReference('ProtoGeometry')
from Autodesk.DesignScript.Geometry import *
#The inputs to this node will be stored as a list in the IN variables.
dataEnteringNode = IN

choice1 = IN[0]
choice2 = IN[1]
choice3 = IN[2]
num = IN[3]

if num == 1:
	OUT = choice1
elif num == 2:
	OUT = choice2
elif num == 3:
	OUT = choice3
else:
	OUT = choice1
# ----------------------------------------
VARFalseBasePointTrueSurveyPoint = Input(VARFalseBasePointTrueSurveyPoint: var[]..[])
location_of_any_element_with = Custom[Location Of Any Element With Coordination System](VARElements=python_script_2, VARFalseBasePointTrueSurveyPoint=VARFalseBasePointTrueSurveyPoint)  # Location Of Any Element
count = List.Count(list=python_script_2@L2)
chop_3 = List.Chop(list=location_of_any_element_with.VARCoordinationSystems, lengths=count)
flatten_2 = List.Flatten(list=chop_3)
chop_4 = List.Chop(list=location_of_any_element_with.VARElements, lengths=count)
flatten_3 = List.Flatten(list=chop_4)
getCategory = Element.GetCategory(element=flatten_3)
string_from_object = FromObject(obj=getCategory)
code_block_7 = CodeBlock { "Lighting Fixtures"; }
eq_4 = string_from_object == code_block_7
filterByBoolMask_3 = List.FilterByBoolMask(list=flatten_2, mask=eq_4)
ZXPlane = CoordinateSystem.ZXPlane(coordinateSystem=filterByBoolMask_3.in)
XYPlane = CoordinateSystem.XYPlane(coordinateSystem=filterByBoolMask_3.out)
mergeByBoolMask = Custom[SP.List.MergeByBoolMask](VARIn=ZXPlane, VAROut=XYPlane, VARmask=eq_4)  # Merge two lists by a boolean mask list. The true count in the mask should be the same as the length of the true list and vice versa for the false list.
byWidthLength = Rectangle.ByWidthLength(plane=mergeByBoolMask)
byPatch = Surface.ByPatch(closedCurve=byWidthLength)
categories = Categories("OST_GenericModel")  # graph input
python_script_3 = Python(IN[0]=byPatch, IN[1]=categories)
# ---------- python_script_3.python (71 lines) ----------
# Enable Python support and load DesignScript library
# IMPORTANT : ALL DYNAMO DESIGN SCRIPT NODES ARE AS (dg)
import sys
sys.path.append(r'C:\Program Files (x86)\IronPython 2.7\DLLs')
sys.path.append(r'C:\Program Files (x86)\IronPython 2.7\Lib')
import random

import clr
clr.AddReference('ProtoGeometry')
from Autodesk.DesignScript import Geometry as dg

# EXTENSION Enable ToDSType
clr.AddReference('RevitNodes')
import Revit
clr.ImportExtensions(Revit.Elements)

# Enable Revit Elements
from Revit.Elements import *

# EXTENSION Enable Geometry Conversion Methods
clr.ImportExtensions(Revit.GeometryConversion)

# Enable Revit API
clr.AddReference('RevitAPI')
from Autodesk.Revit.DB import *

# Enable DocumentManager and TransactionManager
clr.AddReference('RevitServices')
from RevitServices.Persistence import DocumentManager
from RevitServices.Transactions import TransactionManager

# Enable ICollection List Translate
clr.AddReference("System")
import System.Collections.Generic
from System.Collections.Generic import List

def tolist(obj1):
	if hasattr(obj1,'__iter__'): return obj1
	else: return [obj1]

dataEnteringNode = IN
# Use UnwrapElement(IN[0]) When Translating From Dynamo to Revit
surfs = UnwrapElement(tolist(IN[0]))
cat = IN[1]

# Choose The Current Document
doc = DocumentManager.Instance.CurrentDBDocument
uidoc = DocumentManager.Instance.CurrentUIApplication.ActiveUIDocument
uiapp = DocumentManager.Instance.CurrentUIApplication
app = uiapp.Application

# Create Empty List
result = []
dshapes = []
# Start a Transaction with Current Document (doc)
TransactionManager.Instance.EnsureInTransaction(doc)

nums = len(surfs)

for e in surfs:
	name = "DirectShape" + str(random.randint(10, 100000000000))
	dshape = Revit.Elements.DirectShape.ByGeometry(e,cat,Revit.Elements.DirectShape.DynamoPreviewMaterial,name)
	dface = dshape.Faces
	result.append(dface)
	dshapes.append(dshape)

# End the Transaction with Current Document ()
TransactionManager.Instance.TransactionTaskDone()

# Assign your output to the OUT variable.
OUT = result,dshapes
# ----------------------------------------
code_block_8 = CodeBlock(a=python_script_3) { a[0]; a[1]; }
flatten_4 = List.Flatten(list=code_block_8.out0)
chop_5 = List.Chop(list=location_of_any_element_with.VARLocations, lengths=count)
flatten_5 = List.Flatten(list=chop_5)
filterByBoolMask_4 = List.FilterByBoolMask(list=flatten_5, mask=eq_4)
ZAxis = CoordinateSystem.ZAxis(coordinateSystem=filterByBoolMask_3.in)
VARMoveLightingFixturesByDistance = Input(VARMoveLightingFixturesByDistance: var[]..[])
translate = Geometry.Translate(geometry=filterByBoolMask_4.in, direction=ZAxis, distance=VARMoveLightingFixturesByDistance)
mergeByBoolMask_2 = Custom[SP.List.MergeByBoolMask](VARIn=translate, VAROut=filterByBoolMask_4.out, VARmask=eq_4)
XAxis = CoordinateSystem.XAxis(coordinateSystem=flatten_2)
byFace = FamilyInstance.ByFace(familyType=VARProxyFamily, face=flatten_4, location=mergeByBoolMask_2, referenceDirection=XAxis)
python_script_4 = Python(IN[0]=byFace, IN[1]=code_block_8.out1)
# ---------- python_script_4.python (56 lines) ----------
# Enable Python support and load DesignScript library
# IMPORTANT : ALL DYNAMO DESIGN SCRIPT NODES ARE AS (dg)
import clr
clr.AddReference('ProtoGeometry')
from Autodesk.DesignScript import Geometry as dg

# EXTENSION Enable ToDSType
clr.AddReference('RevitNodes')
import Revit
clr.ImportExtensions(Revit.Elements)

# Enable Revit Elements
from Revit.Elements import *

# EXTENSION Enable Geometry Conversion Methods
clr.ImportExtensions(Revit.GeometryConversion)

# Enable Revit API
clr.AddReference('RevitAPI')
from Autodesk.Revit.DB import *

# Enable DocumentManager and TransactionManager
clr.AddReference('RevitServices')
from RevitServices.Persistence import DocumentManager
from RevitServices.Transactions import TransactionManager

# Enable ICollection List Translate
clr.AddReference("System")
import System.Collections.Generic
from System.Collections.Generic import List

def tolist(obj1):
	if hasattr(obj1,'__iter__'): return obj1
	else: return [obj1]

dataEnteringNode = IN
# Use UnwrapElement(IN[0]) When Translating From Dynamo to Revit
wait = IN[0]
dshapes = tolist(IN[1])

# Choose The Current Document
doc = DocumentManager.Instance.CurrentDBDocument
uidoc = DocumentManager.Instance.CurrentUIApplication.ActiveUIDocument
uiapp = DocumentManager.Instance.CurrentUIApplication
app = uiapp.Application

# Start a Transaction with Current Document (doc)
TransactionManager.Instance.EnsureInTransaction(doc)

for e in dshapes:
	doc.Delete(UnwrapElement(e).Id)
# End the Transaction with Current Document ()
TransactionManager.Instance.TransactionTaskDone()

# Assign your output to the OUT variable.
OUT = wait
# ----------------------------------------
end = Revit.Transaction.Transaction.End(input=python_script_4)
VARFalseSeparateByFamilyTypeTrueSeprateB = Input(VARFalseSeparateByFamilyTypeTrueSeprateByCategory: var[]..[])
getCategory_2 = Element.GetCategory(element=flatten_3)
string_from_object_2 = FromObject(obj=getCategory_2)
as_list_groupbykey = Custom[AS.[&] List.GroupByKey](VARobjectList=flatten_3, VARkeys=string_from_object_2)  # Sort the items of a list into groups (sublists) based on the corresponding items of a reference list. Example: The list {A,B,C,D,E} with the reference list {1,anyWord,4,anyWord,1} will be grouped into lists as { {A,E}, {B,D}, {C} } and the unique references will be {1, anyWord, 4}.
name = Family.Name()  # unwired: family
groupByFunction = List.GroupByFunction(list=flatten_3, func=name)
scopeIf_4 = Custom[CW.ScopeIf+](VARtest=VARFalseSeparateByFamilyTypeTrueSeprateB, VARtrue=as_list_groupbykey.VARgroups, VARfalse=groupByFunction)
count_2 = List.Count(list=scopeIf_4@L2)
chop_6 = List.Chop(list=end, lengths=count_2)
isNull_2 = Object.IsNull(obj=chop_6)
code_block_9 = CodeBlock { 2; }
normalizeDepth_4 = List.NormalizeDepth(list=isNull_2, rank=code_block_9)
allTrue = List.AllTrue(list=normalizeDepth_4@L2, lacing=Longest)
filterByBoolMask_5 = List.FilterByBoolMask(list=VARViewtoExport, mask=allTrue)
get_family_and_type_name_by = Custom[Get Family and Type Name By Family Instance](VARFamilyInstance=groupByFunction@L2)  # Get Family and Type Name
code_block_10 = CodeBlock { " "; }
code_block_11 = CodeBlock(a=get_family_and_type_name_by.VARFamilyName, b=code_block_10, c=get_family_and_type_name_by.VARTypeName) { a+b+c; }
firstItem = List.FirstItem(list=code_block_11@L2)
scopeIf_5 = Custom[CW.ScopeIf+](VARtest=VARFalseSeparateByFamilyTypeTrueSeprateB, VARtrue=as_list_groupbykey.VARuniquekeys, VARfalse=firstItem)
filterByBoolMask_6 = List.FilterByBoolMask(list=scopeIf_5, mask=allTrue)
viewDuplicate = Custom[QU.ViewDuplicate](VARViews=filterByBoolMask_5.out, VARNames=filterByBoolMask_6.out, lacing=Longest)  # Duplicate views with given names.
flatten_6 = List.Flatten(list=viewDuplicate)
filterByBoolMask_7 = List.FilterByBoolMask(list=flatten_6, mask=allTrue)
filterByBoolMask_8 = List.FilterByBoolMask(list=chop_6, mask=allTrue)
permanentlyIsolateInView = Custom[CW.Element.PermanentlyIsolateInView](VARview=filterByBoolMask_7.out@L1, VARelement=filterByBoolMask_8.out@L2)  # (Permanently) isolates elements in the given view
end_2 = Revit.Transaction.Transaction.End(input=permanentlyIsolateInView.VARview)
ds_export_to_fbx = Custom[DS.Export to FBX](VARExportFolderPath=VARExportFolderPath, VARprefix=VARprefix, VAR3DViews=end_2@L1)  # Exports 3D views to FBX format
VARFBX = Output(ds_export_to_fbx)
create_2 = List.Create(item0=end_2, item1=end, item2=VARViewtoExport)
VAROutPut = Output(create_2)
VARElements_2 = Output(scopeIf_4)  # "VARElements"
