# Dynamo custom node Auto Family Parameters Associate.dyf (Dynamo 2.1.0.7500)
# category: Synthesize.Automate.Family
# Auto Family Parameters Associate

VARFamilyInstance = Input(VARFamilyInstance: var[]..[])
VAREverything = Input(VAREverything: bool = true)
VARNewParametersPrefix = Input(VARNewParametersPrefix: string = "")
VARBuiltInParameterGroup = Input(VARBuiltInParameterGroup: string = "PG_GEOMETRY")
translate_builtin_parameter = Custom[Translate BuiltIn Parameter Group](VARBuiltInParameterGroupString=VARBuiltInParameterGroup)  # Translate BuiltIn Parameter Group
python_script = Python(IN[0]=VARFamilyInstance, IN[1]=VAREverything, IN[2]=VARNewParametersPrefix, IN[3]=translate_builtin_parameter)
# ---------- python_script.python (361 lines) ----------
# Proudly created by Karam Baki: karam@aecedx.com

# Import crl
import clr

# Enable Revit API
clr.AddReference('RevitAPI')
from Autodesk.Revit.DB import *

# Enable DocumentManager and TransactionManager
clr.AddReference('RevitServices')
from RevitServices.Persistence import DocumentManager
from RevitServices.Transactions import TransactionManager

# Import os
clr.AddReference("System")
import System
import sys
pf_path = System.Environment.GetFolderPath(System.Environment.SpecialFolder.ProgramFilesX86)
sys.path.append('%s\IronPython 2.7\Lib' %pf_path)
import os

clr.AddReference("RevitAPIUI")
from Autodesk.Revit.UI import TaskDialog

# Dump External Definition Create
def exdef(param_name,param_guid,param_type,uiapp):
	app = uiapp.Application
	originalfile = uiapp.Application.SharedParametersFilename
	temp_path = System.IO.Path.GetTempPath()
	temp_file = temp_path + "Karam_Temp_Shared.txt"
	open(temp_file, 'a').close()
	uiapp.Application.SharedParametersFilename = temp_file
	definition_file = app.OpenSharedParameterFile()
	try:
		definition_file.Groups.Create("Karam Group")
	except:
		pass
	definition_groups = definition_file.Groups
	for group in definition_groups:
		ops = ExternalDefinitionCreationOptions(param_name, param_type)
		ops.GUID = param_guid
		try:
			group.Definitions.Create(ops)
		except:
			pass
	exdef = list(list(definition_groups)[0].Definitions)[0]
	return exdef,originalfile,temp_file

# Simple Flatten
def flatten(x):
    result = []
    for el in x:
        if hasattr(el, "__iter__") and not isinstance(el, basestring):
            result.extend(flatten(el))
        else:
            result.append(el)
    return result

# Get Family Instance Information
def getinstanceinfo(sourceinstance):
	family = sourceinstance.Symbol.Family
	familyname = family.Name
	famtype = sourceinstance.Symbol
	famtypename = sourceinstance.Symbol.GetParameters("Type Name")[0].AsString()
	return family,familyname,famtype,famtypename

# Get ElementId or Value String
def bestparamvalue(famdoc,famtype,famparam):
	if famdoc == None and famtype == None:
		ParamValueString = famparam.AsElementId()
		if ParamValueString.ToString() == "-1":
			storagetype = str(famparam.StorageType)
			try:
				if storagetype == "Integer":
					ParamValueString = famparam.AsInteger()
				elif storagetype == "Double":
					ParamValueString = famparam.AsDouble()
				elif storagetype == "String":
					ParamValueString = famparam.AsString()
			except:
				ParamValueString = famparam.AsValueString()
		else:
			try:
				ParamValueString = famparam.AsValueString()
			except:
				ParamValueString = None
	else:
		ParamValueString = famtype.AsElementId(famparam)
		if ParamValueString.ToString() == "-1":
			storagetype = str(famparam.StorageType)
			try:
				if storagetype == "Integer":
					ParamValueString = famtype.AsInteger(famparam)
				elif storagetype == "Double":
					ParamValueString = famtype.AsDouble(famparam)
				elif storagetype == "String":
					ParamValueString = famtype.AsString(famparam)
			except:
				ParamValueString = famtype.AsValueString(famparam)
		else:
			try:
				if famdoc != None:
					ParamValueString = famdoc.GetElement(ParamValueString).Name
				else:
					ParamValueString = famtype.AsValueString(famparam)
			except:
				ParamValueString = famtype.AsValueString(famparam)
	return ParamValueString

# Get/Create Wanted Family Type
def getfamtype(famdoc,famtypename = None):
	alltypes = famdoc.FamilyManager.Types
	if len(list(alltypes)) == 1 or famtypename == None:
		famtype = famdoc.FamilyManager.CurrentType
	elif len(list(alltypes)) == 0 or famtypename == None:
		famtype = famdoc.FamilyManager.NewType(famtypename)
		famdoc.FamilyManager.CurrentType = famtype
	else:
		for t in alltypes:
			if t.Name == famtypename:
				famdoc.FamilyManager.CurrentType = t
				famtype = t
				break
	return famtype

# Get Batch Family Parameters Information Function
def famparaminfo(famparam,famdoc,famtype = None):
	if famtype == None:
		famtype = famdoc.FamilyManager.CurrentType
	ParamName = famparam.Definition.Name
	is_shared = famparam.IsShared
	ParamValueString = bestparamvalue(famdoc,famtype,famparam)
	if ParamValueString == None:
		try:
			ParamValueString = famtype.AsString(famparam)
		except:
			pass
	ParamType = famparam.Definition.ParameterType
	BuiltinParam = famparam.Definition.BuiltInParameter
	BuiltinGroup = famparam.Definition.ParameterGroup
	is_instance = famparam.IsInstance
	if is_shared:
		guid = famparam.GUID
	else:
		guid = None
	formula = famparam.Formula
	if formula == None:
		is_formuladefined = False
	else:
		is_formuladefined = True
	if len(list(famparam.AssociatedParameters)):
		is_associated = True
	else:
		is_associated = False
	return famparam,ParamValueString,ParamName,ParamType,BuiltinParam,BuiltinGroup,is_instance,is_shared,guid,formula,is_formuladefined,is_associated

# Get Batch Family Parameter Information
def getparaminfo(famdoc,famtype = None):
	if famtype == None:
		famtype = famdoc.FamilyManager.CurrentType
	allparams = list(famdoc.FamilyManager.GetParameters())
	info= []
	for famparam in allparams:
		batchinfo = famparaminfo(famparam,famdoc,famtype)
		if str(batchinfo[3]) != "LoadClassification":
			info.append(batchinfo)
	tochecklater = []
	for i in info:
		if i[9] != None:
			splitted = i[9].Split(" ")
			tochecklater.append(splitted)
	tochecklater = flatten(tochecklater)
	important = []
	for i in info:
		name = i[2]
		if name in tochecklater or i[7] == True or i[3].ToString() == "Material":
			important.append(True)
		else:
			important.append(False)
	newinfo = []
	count = 0
	for im in important:
		currentinfo = info[count]
		count += 1
		tmp = []
		if im:
			if currentinfo[9] == None:
				#status = "Normal Importance"
				status = True
			else:
				#status = "Delayed Importance"
				status = True
			for i in currentinfo:
				tmp.append(i)
			tmp.append(status)
		else:
			for i in currentinfo:
				tmp.append(i)
			tmp.append(False)
		newinfo.append(tmp)
	return newinfo

# Initial Family Instance Information
def initialop(projectdoc,sourceinstance):
	initialinfo = getinstanceinfo(sourceinstance)
	family = initialinfo[0]
	familyname = initialinfo[1]
	projectfamtype = initialinfo[2]
	famtypename = initialinfo[3]
	TransactionManager.Instance.ForceCloseTransaction()
	famdoc = projectdoc.EditFamily(family)
	trans1 = Transaction(famdoc, 'Initial Operation')
	trans1.Start()
	originalcat = famdoc.OwnerFamily.FamilyCategory.Name
	famtype = getfamtype(famdoc,famtypename)
	allinfo = getparaminfo(famdoc,famtype)
	trans1.Commit()
	paraminfo = allinfo
	instanceparameters = sourceinstance.GetOrderedParameters()
	namesandvalues = []
	for ins in  instanceparameters:
		namesandvalues.append([ins.Definition.Name,bestparamvalue(None,None,ins)])
	for p in paraminfo:
		for nv in  namesandvalues:
			if p[2] == nv[0]:
				p[1] = nv[1]
				break
	return famdoc,paraminfo,originalcat,famtypename

# Create New Family
def creatparameters(famdoc,uiapp,paraminfo,prefix):
	try:
		TransactionManager.Instance.ForceCloseTransaction()
		trans1 = Transaction(famdoc, 'Auto Create Parameters')
		trans1.Start()
		famtype = famdoc.FamilyManager.CurrentType
		if famtype == None:
			trans1.Commit()
			loaded = None
			TaskDialog.Show("AECedx - Karam",  "Please Manually Create 1 Type or Parameter")
		else:
			for p in paraminfo:
				try:
					instatus = p[6]
					if p[7] == True and prefix == "":
						externaldefOP = exdef(p[2],p[8],p[3],uiapp)
						externaldef = externaldefOP[0]
						try:
							freshparam = famdoc.FamilyManager.AddParameter(externaldef,p[5],instatus)
						except:
							pass
						uiapp.Application.SharedParametersFilename = externaldefOP[1]
						os.remove(externaldefOP[2])
					else:
						freshparam = famdoc.FamilyManager.AddParameter(prefix + p[2],p[5],p[3],instatus)
				except:
					pass
			trans1.Commit()
			loaded = famdoc
	except:
		try:
			trans1.Commit()
		except:
			pass
		TransactionManager.Instance.ForceCloseTransaction()
		loaded = None
	return loaded

# Load Family
def associateOP(famdoc,doc,famtypename,paraminfo,newinstace,prefix):
	try:
		if famdoc != None and doc != None:
			symbol1 = newinstace.Symbol
			TransactionManager.Instance.ForceCloseTransaction()
			trans1 = Transaction(doc, 'Auto Associate Parameters')
			trans1.Start()
			famtype = doc.FamilyManager.CurrentType
			if famtype == None:
				trans1.Commit()
				famdoc.Close(False)
			else:
				if not symbol1.IsActive: symbol1.Activate()
				famtypeparams = list(symbol1.GetOrderedParameters()) + list(newinstace.GetOrderedParameters())
				allparams = list(doc.FamilyManager.GetParameters())
				for elemparm in famtypeparams:
					for famparam in allparams:
						if prefix + elemparm.Definition.Name == famparam.Definition.Name:
							for p in paraminfo:
								if prefix + p[2] == famparam.Definition.Name:
									if p[3].ToString() == "Material":
										mat_fec = FilteredElementCollector(doc).OfClass(Material)
										for m in mat_fec:
											if m.Name.lower() == str(p[1]).lower():
												doc.FamilyManager.Set(famparam,m.Id)
									else:
										try:
											doc.FamilyManager.Set(famparam,p[1])
										except:
											try:
												doc.FamilyManager.SetValueString(famparam,p[1])
											except:
												pass
									try:
										if p[10]:
											doc.FamilyManager.SetFormula(famparam,p[9])
									except:
										pass
							try:
								doc.FamilyManager.AssociateElementParameterToFamilyParameter(elemparm,famparam)
							except:
								pass
				trans1.Commit()
				famdoc.Close(False)
			return famtype
		else:
			return "ERROR"
	except:
		try:
			trans1.Commit()
		except:
			pass
		TransactionManager.Instance.ForceCloseTransaction()
		return "ERROR"

# Initial Family Instance Info
sourceinstance = UnwrapElement(IN[0])
everything = IN[1]
prefix = IN[2]
pgroup = UnwrapElement(IN[3])

# Project Document and UI
projectdoc = DocumentManager.Instance.CurrentDBDocument
uiapp = DocumentManager.Instance.CurrentUIApplication

# Getting Info From Initial Family
initialOP = initialop(projectdoc,sourceinstance)

# Variables
initialfamdoc = initialOP[0]
paraminfo = initialOP[1]
originalcat = initialOP[2]
famtypename = initialOP[3]
tofilterfrom = list(sourceinstance.Symbol.GetOrderedParameters()) + list(sourceinstance.GetOrderedParameters())
filtered = []
for each in tofilterfrom:
	name = each.Definition.Name
	if projectdoc.FamilyManager.CanElementParameterBeAssociated(each):
		for p in paraminfo:
			if p[2] == name and everything:
				filtered.append(p)
			elif p[2] == name and everything == False and p[5] == pgroup:
				filtered.append(p)

tGroup = TransactionGroup(projectdoc, 'Auto Associate Parameters')
tGroup.Start()
creatparameters(projectdoc,uiapp,filtered,prefix)
associateOP(initialfamdoc,projectdoc,famtypename,filtered,sourceinstance,prefix)
tGroup.Assimilate()

OUT = "Done"
# ----------------------------------------
VAROutput = Output(python_script)
