# Dynamo custom node Auto Pads By Rooms.dyf (Dynamo 2.1.0.7500)
# category: Synthesize.Automate.Topography
# Auto Pads By Rooms

categories = Categories("OST_Rooms")  # graph input
all_elements_of_category = ElementsOfCategory(Category=categories)
VARBuildingPadTypeName = Input(VARBuildingPadTypeName: var[]..[])
building_pad_type_selector = Custom[Building Pad Type Selector](VARBuildingPadTypeName=VARBuildingPadTypeName)  # Building Pad Type Selector
VARMethodFalseAutoAITrueHumanAttractors = Input(VARMethodFalseAutoAITrueHumanAttractors: var[]..[])
VARAttractors = Input(VARAttractors: var[]..[])
code_block = CodeBlock { true; }
location_of_any_element = Custom[Location Of Any Element](VARElements=VARAttractors, VARGetAllPointsOfAdaptiveComponents=code_block)  # Location Of Any Element
flatten = List.Flatten(list=location_of_any_element.VARLocations)
VARSelectRoomsAtLevel = Input(VARSelectRoomsAtLevel: var[]..[])
VARSlowMotion = Input(VARSlowMotion: var[]..[])
python_script = Python(IN[0]=all_elements_of_category, IN[1]=building_pad_type_selector, IN[2]=VARMethodFalseAutoAITrueHumanAttractors, IN[3]=flatten, IN[4]=VARSelectRoomsAtLevel, IN[5]=VARSlowMotion)
# ---------- python_script.python (287 lines) ----------
#Created By Karam Baki : karam@aecedx.com
import clr
#Import Revit Services
clr.AddReference ("RevitServices")
import RevitServices
from RevitServices.Persistence import DocumentManager
from RevitServices.Transactions import TransactionManager
#Import Revit API
clr.AddReference('RevitAPI')
from Autodesk.Revit.DB import *
from Autodesk.Revit.DB.Architecture import *
clr.AddReference('RevitAPIUI')
from Autodesk.Revit.UI import *
#Import Revit Node
clr.AddReference('RevitNodes')
import Revit
clr.ImportExtensions(Revit.GeometryConversion)
clr.ImportExtensions(Revit.Elements)
#Import Proto Geometry
clr.AddReference('ProtoGeometry')
from Autodesk.DesignScript import Geometry as dg

import System
from System.Collections.Generic import *

def tolist(obj1):
	if hasattr(obj1,'__iter__'): return obj1
	else: return [obj1]
	
def flatten(x):
    result = []
    for el in x:
        if hasattr(el, "__iter__") and not isinstance(el, basestring):
            result.extend(flatten(el))
        else:
            result.append(el)
    return result

def get_topo(pads,doc):
	pads = tolist(pads)
	topos = FilteredElementCollector(doc).OfCategory(BuiltInCategory.OST_Topography).WhereElementIsNotElementType().ToElements()
	bbox = []
	volumes = []
	padsbbox = []
	for e in topos:
		try:
			bb = e.get_BoundingBox(None).ToProtoType()
			bbox.append(bb)
			cub = bb.ToCuboid()
			vol = cub.Volume
			volumes.append(vol)
			cub.Dispose()
		except:
			pass
	maxvol = max(volumes)
	biggest = []
	counter = 0
	for e in volumes:
		if maxvol == e:
			biggest = bbox[counter]
			break
		counter += 1
		
	minp = biggest.MinPoint
	maxp = biggest.MaxPoint
	
	for p in pads:
		pbox = p.get_BoundingBox(None).ToProtoType()
		pboxmin = pbox.MinPoint
		pboxmax = pbox.MaxPoint
		newmin = dg.Point.ByCoordinates(pboxmin.X,pboxmin.Y,minp.Z)
		newmax = dg.Point.ByCoordinates(pboxmax.X,pboxmax.Y,maxp.Z)
		pbox = dg.BoundingBox.ByCorners(newmin,newmax)
		padsbbox.append(pbox)
	final = []
	for e in padsbbox:
		counter = 0
		for x in bbox:
			if dg.BoundingBox.Intersects(e,x):
				final.append(topos[counter])
			counter += 1
	final = list(set(final))
	return final

dataEnteringNode = IN
# Use UnwrapElement(IN[0]) When Translating From Dynamo to Revit
rooms=UnwrapElement(tolist(IN[0]))
typeId = UnwrapElement(IN[1]).Id
method = IN[2]
attractors = UnwrapElement(tolist(IN[3]))
leveltoselect = UnwrapElement(IN[4]).Id
slowmotion = IN[5]

# Choose The Current Document
doc = DocumentManager.Instance.CurrentDBDocument
uidoc = DocumentManager.Instance.CurrentUIApplication.ActiveUIDocument
uiapp = DocumentManager.Instance.CurrentUIApplication
app = uiapp.Application

selectedrooms = []
for r in rooms:
	currentlevelID = r.get_Parameter(BuiltInParameter.ROOM_LEVEL_ID).AsElementId()
	if currentlevelID == leveltoselect and r.Area != 0:
		selectedrooms.append(r)
rooms = selectedrooms

topo = get_topo(rooms,doc)
topopolycurves = []
opt1 = Options()
for t in topo:
	geoms = t.get_Geometry(opt1)
	for g in geoms:
		if g.ToString() == "Autodesk.Revit.DB.PolyLine":
			try:
				topopolycurves.append(g.ToProtoType())
			except: pass

for r in rooms:
	try:
		opt = SpatialElementBoundaryOptions()
		loops = r.GetBoundarySegments(opt)
		for each in loops:
			#Check line in each loop
			for e in each:
				curvelem = e.GetCurve()
				dyntmp = curvelem.ToProtoType()
				break
			break
	except:
		pass

newp = dg.Point.ByCoordinates(0,0,0)
coortomoveto = dg.CoordinateSystem.ByOrigin(newp)
movedtopopolycurves = []
movedattractors = []
newtopopolycurves = []
for e in topopolycurves:
	zpol = e.StartPoint.Z
	newp = dg.Point.ByCoordinates(0,0,zpol)
	coorfrom = dg.CoordinateSystem.ByOrigin(newp)
	try:
		movedtopopolycurves.append(dg.Geometry.Transform(e,coorfrom,coortomoveto))
		newtopopolycurves.append(e)
	except:
		pass
topopolycurves = newtopopolycurves
	
for e in attractors:
	xp = e.X
	yp = e.Y
	newp = dg.Point.ByCoordinates(xp,yp,0)
	coortomoveto = dg.CoordinateSystem.ByOrigin(newp)
	coorfrom = dg.CoordinateSystem.ByOrigin(e)
	movedattractors.append(dg.Geometry.Transform(e,coorfrom,coortomoveto))

# Create Empty List
result = []
result2 = []
result3 = []
if slowmotion == False:
	TransactionManager.Instance.EnsureInTransaction(doc)
	
for r in rooms:
	try:
		currentlevelID = r.get_Parameter(BuiltInParameter.ROOM_LEVEL_ID).AsElementId()
		opt = SpatialElementBoundaryOptions()
		loops = r.GetBoundarySegments(opt)
		
		#Check loops in each room
		all_loops = []
		all_polies = []
		areas = []
		for each in loops:
			tmploops = CurveLoop()
			dyntmp = []
			
			#Check line in each loop
			for e in each:
				curvelem = e.GetCurve()
				tmploops.Append(curvelem)
				dyntmp.append(curvelem.ToProtoType())
				
			#Join Lines of each inner loop
			joineddyntmp = dg.PolyCurve.ByJoinedCurves(dyntmp)
			patching = dg.Surface.ByPatch(joineddyntmp)
			area = patching.Area
			patching.Dispose()
			roomspoly = [joineddyntmp]

			#Check each inner loop distances
			wantedpolies = []
			for p in roomspoly:
				newp = dg.Point.ByCoordinates(0,0,0)
				coortomoveto = dg.CoordinateSystem.ByOrigin(newp)
				zpol = p.StartPoint.Z
				newp = dg.Point.ByCoordinates(0,0,zpol)
				coorfrom = dg.CoordinateSystem.ByOrigin(newp)
				p = dg.Geometry.Transform(p,coorfrom,coortomoveto)
				intersects = []
				movedintersects = []
				
				#Measure to each attractor
				counter = 0
				for x in movedtopopolycurves:
					try:
						if dg.Geometry.DoesIntersect(p,x):
							intersects.append(topopolycurves[counter])
							movedintersects.append(x)
					except: pass
					counter += 1
				if len(intersects) == 0:
					emergencydises = []
					counter = 0
					for x in movedtopopolycurves:
						try:
							emergencydises.append(dg.Geometry.DistanceTo(p,x))
						except:
							emergencydises.append(1844674407)
						counter += 1
					emergmdis = min(emergencydises)
					emergcounter = 0
					for emerg in emergencydises:
						if emergmdis == emerg:
							break
						emergcounter += 1
					intersects = [topopolycurves[emergcounter]]
					movedintersects = [movedtopopolycurves[emergcounter]]
				alltmp = []
				allint = []
				counter = 0
				chosenattractos = []
				chosendistances = []
				if method == False:
					movedattractors = movedtopopolycurves
				for atr in movedattractors:
					try:
						chosendistances.append(dg.Geometry.DistanceTo(p,atr))
					except:
						chosendistances.append(None)
				minchosen = min(chosendistances)
				chosecount = 0
				for choatr in chosendistances:
					if minchosen == choatr:
						movedattractorstmp = [movedattractors[chosecount]]
						break
					chosecount += 1
				for i in movedintersects:
					tmplist = []
					intlist = []
					for a in movedattractorstmp:
						try:					
							tmplist.append(dg.Geometry.DistanceTo(i,a))
						except:
							tmplist.append(None)
						intlist.append(intersects[counter])
					alltmp.append(tmplist)
					allint.append(intlist)
					counter += 1
				flattendistances = flatten(alltmp)
				flattenint = flatten(allint)
				mindistanceofall = min(flattendistances)
				counter = 0
				for d in flattendistances:
					if d == mindistanceofall:
						wantedpoly = flattenint[counter].StartPoint
						break
					counter += 1
				wantedpolies.append(wantedpoly)	
			all_polies.append(wantedpolies)
			all_loops.append(tmploops)
			areas.append(area)
		if slowmotion:
			Revit.Transaction.Transaction.End(doc)
			TransactionManager.Instance.EnsureInTransaction(doc)
		result.append(BuildingPad.Create(doc,typeId,currentlevelID,all_loops))
		if slowmotion:
			TransactionManager.Instance.TransactionTaskDone()
		result2.append(all_polies)
		result3.append(areas)
	except:
		pass

if slowmotion == False:
	TransactionManager.Instance.TransactionTaskDone()

# Assign your output to the OUT variable
OUT = result,result2,result3
# ----------------------------------------
code_block_2 = CodeBlock(a=python_script) { a[0]; a[1]; a[2]; }
flatten_2 = List.Flatten(list=code_block_2.out0)
code_block_3 = CodeBlock { "Level"; "Height Offset From Level"; }
code_block_4 = CodeBlock { 0.001; false; true; 1; }
VARUseAllLevels = Input(VARUseAllLevels: var[]..[])
element_types = ElementTypes("Level")
all_elements_of_type = ElementsOfType(element_type=element_types)
hot_get_all_filter = Custom[HOT.Get All Filter]()  # Get all Filter
VARLevelsSelectionFiltertoRead = Input(VARLevelsSelectionFiltertoRead: var[]..[])
eq = hot_get_all_filter.VARName == VARLevelsSelectionFiltertoRead
filterByBoolMask = List.FilterByBoolMask(list=hot_get_all_filter.VARElement, mask=eq)
elements = Custom[CW.SelectionSet.Elements](VARselectionSet=filterByBoolMask.in)  # Retrieves all elements stored in a selection set
flatten_3 = List.Flatten(list=elements)
scopeIf = Custom[CW.ScopeIf+](VARtest=VARUseAllLevels, VARtrue=all_elements_of_type, VARfalse=flatten_3)  # A (hopefully) more robust implementation of ScopeIf. Tests a single boolean and returns a value accordingly.
flatten_4 = List.Flatten(list=scopeIf)
maximumItem = List.MaximumItem(list=code_block_2.out2)
eq_2 = maximumItem == code_block_2.out2
filterByBoolMask_2 = List.FilterByBoolMask(list=code_block_2.out1, mask=eq_2)
flatten_5 = List.Flatten(list=filterByBoolMask_2.in)
VARHeightOffset = Input(VARHeightOffset: var[]..[])
detect_levels_of_points = Custom[Detect Levels of Points](VARSetOffsetParameter=code_block_4.out2, VARRoundingValue=code_block_4.out0, VARRoundingFix=code_block_4.out1, VARFixFactorDependsofProjectUnits1Formetersforexampleand100forCentimeters=code_block_4.out3, VARLevels=flatten_4, VARPoints=flatten_5, VARZLocationOffset=VARHeightOffset)  # Detect Levels of Points From Family Refine Levels and Offset
setParameterByName = Element.SetParameterByName(element=flatten_2, parameterName=code_block_3.out0, value=detect_levels_of_points.VARLevelsSet)
setParameterByName_2 = Element.SetParameterByName(element=flatten_2, parameterName=code_block_3.out1, value=detect_levels_of_points.VARElevationsSet)
VARBuildingPads = Output(flatten_2)
VARBuildingPadType = Output(building_pad_type_selector)
