# Dynamo custom node Auto Walls By Surfaces.dyf (Dynamo 2.1.0.7500)
# category: Synthesize.Automate.Wall
# Auto Walls By Surfaces

VARSegmentWalls = Input(VARSegmentWalls: var[]..[])
VARSegmentationDistance = Input(VARSegmentationDistance: var[]..[])
code_block = CodeBlock { 0; true; }
eq = VARSegmentationDistance == code_block.out0
scopeIf = Custom[CW.ScopeIf+](VARtest=VARSegmentWalls, VARtrue=eq, VARfalse=code_block.out1)  # A (hopefully) more robust implementation of ScopeIf. Tests a single boolean and returns a value accordingly.
VARFetchAllSurfaces = Input(VARFetchAllSurfaces: bool = false)
VARSurface = Input(VARSurface: var[]..[])
fetch_whole_body = Custom[Fetch Whole Body](VARFetchorNot=VARFetchAllSurfaces, VARSurfaces=VARSurface)  # Fetch Whole Body
flatten = List.Flatten(list=fetch_whole_body)
isPlanar = Custom[CW.Surface.IsPlanar](VARsurface=flatten)  # Checks whether a face is planar
filterByBoolMask = List.FilterByBoolMask(list=flatten, mask=isPlanar)
python_script = Python(IN[0]=filterByBoolMask.in)
# ---------- python_script.python (61 lines) ----------
# Enable Python support and load DesignScript library
# IMPORTANT : ALL DYNAMO DESIGN SCRIPT NODES ARE AS (dg)
import clr
clr.AddReference('ProtoGeometry')
from Autodesk.DesignScript import Geometry as dg

# EXTENSION Enable ToDSType
clr.AddReference('RevitNodes')
import Revit
clr.ImportExtensions(Revit.Elements)

# Enable Revit Elements
from Revit.Elements import *

# EXTENSION Enable Geometry Conversion Methods
clr.ImportExtensions(Revit.GeometryConversion)

# Enable Revit API
clr.AddReference('RevitAPI')
from Autodesk.Revit.DB import *

# Enable DocumentManager and TransactionManager
clr.AddReference('RevitServices')
from RevitServices.Persistence import DocumentManager
from RevitServices.Transactions import TransactionManager

# Enable ICollection List Translate
clr.AddReference("System")
import System.Collections.Generic
from System.Collections.Generic import List

pf_path = System.Environment.GetFolderPath(System.Environment.SpecialFolder.ProgramFilesX86)
import sys
sys.path.append('%s\IronPython 2.7\Lib' %pf_path)
import random

dataEnteringNode = IN
# Use UnwrapElement(IN[0]) When Translating From Dynamo to Revit
surfs=UnwrapElement(IN[0])

# Choose The Current Document
doc = DocumentManager.Instance.CurrentDBDocument
uidoc = DocumentManager.Instance.CurrentUIApplication.ActiveUIDocument
uiapp = DocumentManager.Instance.CurrentUIApplication
app = uiapp.Application

# Create Empty List
result = []
goodsurfs = []

for s in surfs:
	try:
		offset = dg.Geometry.Translate(s,random.randint(2, 10),random.randint(2, 10),0)
		bbox = dg.BoundingBox.ByGeometry([s,offset])
		result.append(bbox)
		goodsurfs.append(s)
		offset.Dispose()
	except:
		pass
# Assign your output to the OUT variable.
OUT = goodsurfs,result
# ----------------------------------------
code_block_2 = CodeBlock(a=python_script) { a[0]; a[1]; }
perimeterCurves = Surface.PerimeterCurves(surface=code_block_2.out0)
flatten_2 = List.Flatten(list=perimeterCurves@L2)
as_polycurve_bycurves = Custom[AS.[&] PolyCurve.ByCurves](VARcurves=flatten_2)  # Create polycurves from an unordered list of curves.
byPatch = Surface.ByPatch(closedCurve=as_polycurve_bycurves.VARpolyCurve)
area = Surface.Area(surface=byPatch)
maximumItem = List.MaximumItem(list=area)
eq_2 = area == maximumItem
filterByBoolMask_2 = List.FilterByBoolMask(list=as_polycurve_bycurves.VARpolyCurve, mask=eq_2)
curves = PolyCurve.Curves(polyCurve=filterByBoolMask_2.in)
flatten_3 = List.Flatten(list=curves@L2)
curves_offset_to_revit = Custom[Curves Offset To Revit Compatibility](VARCurves=flatten_3)  # Curves Offset To Revit Compatibility
empty = List.Empty()
scopeIf_2 = Custom[CW.ScopeIf+](VARtest=scopeIf, VARtrue=empty, VARfalse=curves_offset_to_revit.VARCurves)
lines_segmentation_by_distance = Custom[Lines Segmentation By Distance](VARCurves=scopeIf_2@L2, VARSegmentationDistance=VARSegmentationDistance)  # Lines Segmentation By Distance
curves_2 = PolyCurve.Curves(polyCurve=lines_segmentation_by_distance)
flatten_4 = List.Flatten(list=curves_2@L3)
simplify = Custom[SP.CurveLoop.Simplify](VARcurveLoop=flatten_4)  # Attempts to simplify an open or a closed curve loop by connecting straight separate line segments into a single line.
scopeIf_3 = Custom[CW.ScopeIf+](VARtest=scopeIf, VARtrue=curves_offset_to_revit.VARCurves, VARfalse=simplify)
VARWallType = Input(VARWallType: var[]..[])
categories = Categories("OST_Levels")  # graph input
all_elements_of_category = ElementsOfCategory(Category=categories)
minPoint = BoundingBox.MinPoint(boundingBox=code_block_2.out1)
code_block_3 = CodeBlock { 1000; }
points_refine_levels_and_offset = Custom[Points Refine Levels and Offset](VARLevels=all_elements_of_category, VARPoints=minPoint, VARFixFactorDependsofProjectUnits1Formetersforexampleand100forCentimeters=code_block_3)  # Family Refine Levels and Offset
flatten_5 = List.Flatten(list=points_refine_levels_and_offset.VARLevelsSet)
VARLocationLine = Input(VARLocationLine: var[]..[])
code_block_4 = CodeBlock { 0.5; }
normalAtParameter = Surface.NormalAtParameter(surface=code_block_2.out0, u=code_block_4, v=code_block_4)
flatten_6 = List.Flatten(list=normalAtParameter)
flatten_7 = List.Flatten(list=points_refine_levels_and_offset.VARElevationsSet)
unit_types = UnitTypes("Length")
displayUnitType = Custom[CW.UnitType.DisplayUnitType](VARunitType=unit_types)  # Retrieves the display unit type for a given unit type.
toInternalUnit = Custom[CW.DisplayUnit.ToInternalUnit](VARval=flatten_7, VARdisplayUnitType=displayUnitType.VARdisplayUnitType)  # Converts a value from a given display unit to Revit's internal unit
walls_by_profiles = Custom[Walls By Profiles](VARCurves=scopeIf_3, VARWallType=VARWallType, VARLevels=flatten_5, VARLocationLine=VARLocationLine, VARVector=flatten_6, VARHeights=toInternalUnit)  # Walls By Curves
VARout = Output(walls_by_profiles)
code_block_5 = CodeBlock { 0; }
