# Dynamo custom node B4S.Quad Panels (Design Script).dyf (Dynamo 2.1.0.7500)
# category: Synthesize.Packages.BIM4Struc.Productivity.Geometry
# Generates quad panels on a surface. The panels surfaces are defined with DesignScript, for use with Project Fractal.

# note: Order the points to get quadrilaterals from the rectangular point grid.

VARWithSurfaces = Input(VARWithSurfaces: bool = false)
VARsurface = Input(VARsurface: Autodesk.DesignScript.Geometry.Surface)
VARu = Input(VARu: int)  # TransversalDivisionnumber
VARv = Input(VARv: int)  # LateralDivisionnumber
# note: Create a rectangular point grid on the roof surface.
code_block = CodeBlock(u=VARu, v=VARv) { 0..1..#u; 0..1..#v; }
pointAtParameter = Surface.PointAtParameter(surface=VARsurface, u=code_block.out0, v=code_block.out1, lacing=CrossProduct)
code_block_2 = CodeBlock(pts=pointAtParameter)
# ---------- code_block_2.designscript (12 lines) ----------
//Order the points to get quadrilaterals from the rectangular point grid
t4 = DSCore.List.ShiftIndices(pts@-2<1>, -1);
t6 = DSCore.List.ShiftIndices(pts, -1);
t7 = DSCore.List.ShiftIndices(t6@-2<1>, -1);
t8 = [pts, t4, t7, t6];
t9 = DSCore.List.Transpose(t8);
t10 = DSCore.List.Transpose(t9@-3<1>);
t11 = DSCore.List.Reverse(t10);
t12 = DSCore.List.RestOfItems(t11);
t13 = DSCore.List.Reverse(t12@-3<1>);
t14 = DSCore.List.RestOfItems(t13@-3<1>);
//surface1 = Surface.ByPerimeterPoints(t14);
# ----------------------------------------
code_block_3 = CodeBlock { 1; }
flatten = List.Flatten(list=code_block_2.t14, amt=code_block_3)
byPoints = Polygon.ByPoints(points=flatten)
empty = List.Empty()
scopeIf = Custom[CW.ScopeIf+](VARtest=VARWithSurfaces, VARtrue=byPoints, VARfalse=empty)  # A (hopefully) more robust implementation of ScopeIf. Tests a single boolean and returns a value accordingly.
byPatch = Surface.ByPatch(closedCurve=scopeIf)
flatten_2 = List.Flatten(list=byPatch)
VARQuadSurfaces = Output(flatten_2)
VARQuadPoints = Output(flatten)
VARQuadPolygons = Output(byPoints)
