# Dynamo custom node BK.Collect all FamilyInstance using Element Types.dyf (Dynamo 2.1.0.7500)
# category: Synthesize.Packages.Bakery.Revit.Selection
# should get model family instances

element_types = ElementTypes("FamilyInstance")  # graph input
all_elements_of_type = ElementsOfType(element_type=element_types)
flatten = List.Flatten(list=all_elements_of_type)
uniqueItems = List.UniqueItems(list=flatten)
VARelements = Output(uniqueItems)
