# Dynamo custom node BK.Get All Views.dyf (Dynamo 2.1.0.7500)
# category: Synthesize.Packages.Bakery.Dynamo.ForkedNodes
# taken from archi-lab

python_script = Python()  # graph input
# ---------- python_script.python (100 lines) ----------
#Copyright(c) 2015, Konrad Sobon
# @arch_laboratory, http://archi-lab.net

import clr
clr.AddReference('ProtoGeometry')
from Autodesk.DesignScript.Geometry import *

# Import DocumentManager and TransactionManager
clr.AddReference("RevitServices")
import RevitServices
from RevitServices.Persistence import DocumentManager
from RevitServices.Transactions import TransactionManager

# Import RevitAPI
clr.AddReference("RevitAPI")
import Autodesk
from Autodesk.Revit.DB import *

doc = DocumentManager.Instance.CurrentDBDocument
uiapp = DocumentManager.Instance.CurrentUIApplication
app = uiapp.Application

from System.Collections.Generic import *

# Import ToDSType(bool) extension method
clr.AddReference("RevitNodes")
import Revit
clr.ImportExtensions(Revit.Elements)

#The inputs to this node will be stored as a list in the IN variable.
dataEnteringNode = IN

#collect all views in the model
collector = FilteredElementCollector(doc)
views = collector.OfClass(View).ToElements()

#sort views into separate lists based on view type
areaPlans, ceilingPlans, columnSchedules = [], [], []
costReport, details, draftingViews = [], [], []
drawingSheets, elevations, engineetingPlans = [], [], []
floorPlans, internal, legends, loadReports = [], [], [], []
panelSchedules, pressureLossReports, renderings = [], [], []
reports, schedules, sections, threeD = [], [], [], []
undefined, walkthrough = [], []
for i in views:
	if not i.IsTemplate:
		if i.ViewType == ViewType.AreaPlan:
			areaPlans.append(i.ToDSType(True))
		elif i.ViewType == ViewType.CeilingPlan:
			ceilingPlans.append(i.ToDSType(True))
		elif i.ViewType == ViewType.ColumnSchedule:
			columnSchedules.append(i.ToDSType(True))
		elif i.ViewType == ViewType.CostReport:
			costReport.append(i.ToDSType(True))
		elif i.ViewType == ViewType.Detail:
			details.append(i.ToDSType(True))
		elif i.ViewType == ViewType.DraftingView:
			draftingViews.append(i.ToDSType(True))
		elif i.ViewType == ViewType.DrawingSheet:
			drawingSheets.append(i.ToDSType(True))
		elif i.ViewType == ViewType.Elevation:
			elevations.append(i.ToDSType(True))
		elif i.ViewType == ViewType.EngineeringPlan:
			engineetingPlans.append(i.ToDSType(True))
		elif i.ViewType == ViewType.FloorPlan:
			floorPlans.append(i.ToDSType(True))
		elif i.ViewType == ViewType.Internal:
			internal.append(i.ToDSType(True))
		elif i.ViewType == ViewType.Legend:
			legends.append(i.ToDSType(True))
		elif i.ViewType == ViewType.LoadsReport:
			loadReports.append(i.ToDSType(True))
		elif i.ViewType == ViewType.PanelSchedule:
			panelSchedules.append(i.ToDSType(True))
		elif i.ViewType == ViewType.PresureLossReport:
			pressureLossReports.append(i.ToDSType(True))
		elif i.ViewType == ViewType.Rendering:
			renderings.append(i.ToDSType(True))
		elif i.ViewType == ViewType.Report:
			reports.append(i.ToDSType(True))
		elif i.ViewType == ViewType.Schedule:
			schedules.append(i.ToDSType(True))
		elif i.ViewType == ViewType.Section:
			sections.append(i.ToDSType(True))
		elif i.ViewType == ViewType.ThreeD:
			threeD.append(i.ToDSType(True))
		elif i.ViewType == ViewType.Undefined:
			undefined.append(i.ToDSType(True))
		elif i.ViewType == ViewType.Walkthrough:
			walkthrough.append(i.ToDSType(True))
		else:
			continue

#Assign your output to the OUT variable
OUT = areaPlans, ceilingPlans, columnSchedules, costReport, \
	details, draftingViews, drawingSheets, elevations, \
	engineetingPlans, floorPlans, internal, legends, \
	loadReports, panelSchedules, pressureLossReports, \
	renderings, reports, schedules, sections, threeD, \
	undefined, walkthrough
# ----------------------------------------
code_block = CodeBlock { 0; 1; 2; 3; 4; 5; 6; 7; 8; 9; 10; 11; 12; 13; 14; 15; 16; 17; 18; 19; 20; 21; }
getItemAtIndex = List.GetItemAtIndex(list=python_script, index=code_block.out15)
VARRenderings = Output(getItemAtIndex)
getItemAtIndex_2 = List.GetItemAtIndex(list=python_script, index=code_block.out14)
VARPressureLossReports = Output(getItemAtIndex_2)
getItemAtIndex_3 = List.GetItemAtIndex(list=python_script, index=code_block.out13)
VARPanelSchedules = Output(getItemAtIndex_3)
getItemAtIndex_4 = List.GetItemAtIndex(list=python_script, index=code_block.out21)
VARWalkthroughs = Output(getItemAtIndex_4)
getItemAtIndex_5 = List.GetItemAtIndex(list=python_script, index=code_block.out7)
VARElevations = Output(getItemAtIndex_5)
getItemAtIndex_6 = List.GetItemAtIndex(list=python_script, index=code_block.out6)
VARDrawingSheets = Output(getItemAtIndex_6)
getItemAtIndex_7 = List.GetItemAtIndex(list=python_script, index=code_block.out5)
VARDraftingViews = Output(getItemAtIndex_7)
getItemAtIndex_8 = List.GetItemAtIndex(list=python_script, index=code_block.out20)
VARUndefinedViews = Output(getItemAtIndex_8)
getItemAtIndex_9 = List.GetItemAtIndex(list=python_script, index=code_block.out4)
VARDetails = Output(getItemAtIndex_9)
getItemAtIndex_10 = List.GetItemAtIndex(list=python_script, index=code_block.out12)
VARLoadsReports = Output(getItemAtIndex_10)
getItemAtIndex_11 = List.GetItemAtIndex(list=python_script, index=code_block.out3)
VARCostReports = Output(getItemAtIndex_11)
getItemAtIndex_12 = List.GetItemAtIndex(list=python_script, index=code_block.out11)
VARLegends = Output(getItemAtIndex_12)
getItemAtIndex_13 = List.GetItemAtIndex(list=python_script, index=code_block.out19)
VAR3DViews = Output(getItemAtIndex_13)
getItemAtIndex_14 = List.GetItemAtIndex(list=python_script, index=code_block.out2)
VARColumnSchedules = Output(getItemAtIndex_14)
getItemAtIndex_15 = List.GetItemAtIndex(list=python_script, index=code_block.out10)
VARInternalViews = Output(getItemAtIndex_15)
getItemAtIndex_16 = List.GetItemAtIndex(list=python_script, index=code_block.out18)
VARSections = Output(getItemAtIndex_16)
getItemAtIndex_17 = List.GetItemAtIndex(list=python_script, index=code_block.out1)
VARCeilingPlans = Output(getItemAtIndex_17)
getItemAtIndex_18 = List.GetItemAtIndex(list=python_script, index=code_block.out9)
VARFloorPlans = Output(getItemAtIndex_18)
getItemAtIndex_19 = List.GetItemAtIndex(list=python_script, index=code_block.out17)
VARSchedules = Output(getItemAtIndex_19)
getItemAtIndex_20 = List.GetItemAtIndex(list=python_script, index=code_block.out0)
VARAreaPlans = Output(getItemAtIndex_20)
getItemAtIndex_21 = List.GetItemAtIndex(list=python_script, index=code_block.out8)
VAREngineeringPlans = Output(getItemAtIndex_21)
getItemAtIndex_22 = List.GetItemAtIndex(list=python_script, index=code_block.out16)
VARReports = Output(getItemAtIndex_22)
