# Dynamo custom node BK.Get Categories from Elements.dyf (Dynamo 2.1.0.7500)
# category: Synthesize.Packages.Bakery.Revit.Document.Category
# "List Unique Categories Present in Set of Elements" is better. This one uses Blackbox Get.CategoryName and Get Categories (designed to use document category list)

VARElements = Input(VARElements: var[]..[])
bk_bv_get_category_name = Custom[BK.bv Get Category Name](VARElements=VARElements)  # forked from Blackbox
uniqueItems = List.UniqueItems(list=bk_bv_get_category_name)
VARCategoriesPresent = Output(uniqueItems)
bk_convert_category_name_to = Custom[BK.Convert Category Name to Built In Category Name](VARcategoryNameOrNames=uniqueItems)  # You must use List.Map to convert list of Category Names to list of Built In Names
VARBuiltIn = Output(bk_convert_category_name_to)
