# Dynamo custom node BK.Get Linked RVT Documents.dyf (Dynamo 2.1.0.7500)
# category: Synthesize.Packages.Bakery.Revit.Document.Links

empty = List.Empty()
python_script = Python(IN[0]=empty)
# ---------- python_script.python (43 lines) ----------
#Copyright(c) 2015, Konrad K Sobon
# @arch_laboratory, http://archi-lab.net

import clr
clr.AddReference('ProtoGeometry')
from Autodesk.DesignScript.Geometry import *

# Import DocumentManager and TransactionManager
clr.AddReference("RevitServices")
import RevitServices
from RevitServices.Persistence import DocumentManager
from RevitServices.Transactions import TransactionManager

from System.Collections.Generic import *

# Import RevitAPI
clr.AddReference("RevitAPI")
import Autodesk
from Autodesk.Revit.DB import *
from Autodesk.Revit.DB.Analysis import *

doc = DocumentManager.Instance.CurrentDBDocument
uiapp = DocumentManager.Instance.CurrentUIApplication
app = uiapp.Application

# Import ToDSType(bool) extension method
clr.AddReference("RevitNodes")
import Revit
clr.ImportExtensions(Revit.Elements)

#The inputs to this node will be stored as a list in the IN variable.
dataEnteringNode = IN

collector = Autodesk.Revit.DB.FilteredElementCollector(doc)
linkInstances = collector.OfClass(Autodesk.Revit.DB.RevitLinkInstance)

linkDoc, linkName, linkInstId = [], [], []
for i in linkInstances:
	linkDoc.append(i.GetLinkDocument())
	linkName.append(i.Name)
	linkInstId.append(i.Id)

OUT = linkDoc, linkName, linkInstances, linkInstId
# ----------------------------------------
number = DoubleInput(0)  # graph input
getItemAtIndex = List.GetItemAtIndex(list=python_script, index=number)
VARLinkDoc = Output(getItemAtIndex)
number_2 = DoubleInput(1)  # graph input
getItemAtIndex_2 = List.GetItemAtIndex(list=python_script, index=number_2)
VARLinkName = Output(getItemAtIndex_2)
number_3 = DoubleInput(2)  # graph input
getItemAtIndex_3 = List.GetItemAtIndex(list=python_script, index=number_3)
VARLinkInstance = Output(getItemAtIndex_3)
number_4 = DoubleInput(3)  # graph input
getItemAtIndex_4 = List.GetItemAtIndex(list=python_script, index=number_4)
VARLinkInstanceId = Output(getItemAtIndex_4)
