# Dynamo custom node BK.Get Type List for this project.dyf (Dynamo 2.1.0.7500)
# category: Synthesize.Packages.Bakery.Revit.Elements.Family

python_script = Python()
# ---------- python_script.python (20 lines) ----------
#Made by Marc Tavenier @marctavenier
import clr
clr.AddReference('RevitAPI')
from Autodesk.Revit.DB import *

clr.AddReference('RevitServices')
import RevitServices
from RevitServices.Persistence import DocumentManager

#The inputs to this node will be stored as a list in the IN variable.
dataEnteringNode = IN

elementlist = []
doc = DocumentManager.Instance.CurrentDBDocument

collector = FilteredElementCollector(doc).OfClass(FamilySymbol)
elementlist = collector.ToElements()

#Assign your output to the OUT variable
OUT = elementlist
# ----------------------------------------
VARFamilySymbols = Output(python_script)
bk_get_system_types_as_list = Custom[BK.Get System Types as List]()  # uses HostObjAttributes parent class to collect
create = List.Create(item0=python_script, item1=bk_get_system_types_as_list)
uniqueItems = List.UniqueItems(list=create)
flatten = List.Flatten(list=uniqueItems)
VARuniquifiedflatlist = Output(flatten)
VARSystemTypes = Output(bk_get_system_types_as_list)
