# Dynamo custom node BK.If Equal Return Index using IndexOf.dyf (Dynamo 2.1.0.7500)
# category: Synthesize.Packages.Bakery.Core.List

VARsearchForThese = Input(VARsearchForThese: var[]..[])
VARinThisList = Input(VARinThisList: var[]..[])
indexOf = List.IndexOf(list=VARinThisList)  # unwired: element
map = List.Map(list=VARsearchForThese, f_x=indexOf)
VARindices = Output(map)
