# Dynamo custom node BK.List of float double to list of Int.dyf (Dynamo 2.1.0.7500)
# category: Synthesize.Packages.Bakery.Core.Math
# no decimals

VARdouble = Input(VARdouble: var[]..[])
python_script = Python(IN[0]=VARdouble)
# ---------- python_script.python (12 lines) ----------
import clr
clr.AddReference('ProtoGeometry')
from Autodesk.DesignScript.Geometry import *
import math
#The inputs to this node will be stored as a list in the IN variables.
dataEnteringNode = IN[0]
listed = []
for x in dataEnteringNode:
	temp = int(round(x))
	listed.append(temp)
#Assign your output to the OUT variable.
OUT = listed
# ----------------------------------------
VARint = Output(python_script)
