# Dynamo custom node BK.Natural Sort List of Strings.dyf (Dynamo 2.1.0.7500)
# category: Synthesize.Packages.Bakery.Core.String

VARlistOfStrings = Input(VARlistOfStrings: var[]..[])
python_script = Python(IN[0]=VARlistOfStrings)
# ---------- python_script.python (9 lines) ----------
# lingkonn@gmail.com

x=IN[0]
import re
def sort(x): 
    convertText = lambda text: int(text) if text.isdigit() else text.lower() 
    Textkey = lambda key: [ convertText(c) for c in re.split('([0-9]+)', key) ] 
    return sorted(x, key = Textkey)
OUT = sort(x)
# ----------------------------------------
# note: via Md Lingkon
VARsortedList = Output(python_script)
