# Dynamo custom node BK.Popup Message Box.dyf (Dynamo 2.1.0.7500)
# category: Synthesize.Packages.Bakery.Dynamo.UI
# from Dynamo Player samples

VARmessage = Input(VARmessage: var[]..[])
python_script = Python(IN[0]=VARmessage)
# ---------- python_script.python (14 lines) ----------
#This script pops up a dialog box with a message from the previous node.
import clr
clr.AddReference('RevitAPIUI')

from Autodesk.Revit.UI import TaskDialog

mainText = IN[0]

msg = mainText
title = "Synthesize toolkit"
alert = TaskDialog
OUT = alert.Show(title, msg)

messagePop.Show()
# ----------------------------------------
VAROUT = Output(python_script)
