# Dynamo custom node BK.Preflight for Section View Creation.dyf (Dynamo 2.1.0.7500)
# category: Synthesize.Packages.Bakery.Revit.Views

VARcsOrigin = Input(VARcsOrigin: var[]..[])
VARxAxis = Input(VARxAxis: Autodesk.DesignScript.Geometry.Vector)
VARyAxis = Input(VARyAxis: Autodesk.DesignScript.Geometry.Vector)

# group: APPLY CS AND WORKPLANE
byOriginVectors = CoordinateSystem.ByOriginVectors(origin=VARcsOrigin, xAxis=VARxAxis, yAxis=VARyAxis, lacing=Longest)

VARCoordinateSystem = Output(byOriginVectors)
VARPointList = Input(VARPointList: var[]..[])
turnIntoList = Custom[CW.TurnIntoList](VARunknownItem=VARPointList)  # Turns an element (or a nested list) into a flat list

# group: TRANSLATE TO WCS FOR minPoint / maxPoint Calc
X = Point.X(point=turnIntoList)
maximumItem = List.MaximumItem(list=X)
Y = Point.Y(point=turnIntoList)
maximumItem_2 = List.MaximumItem(list=Y)
minimumItem = List.MinimumItem(list=X)
minimumItem_2 = List.MinimumItem(list=Y)

VARCropRegionOffset = Input(VARCropRegionOffset: var[]..[])
VARViewDepth = Input(VARViewDepth: var[]..[])
code_block = CodeBlock(CropRegionOffset=VARCropRegionOffset, ViewDepth=VARViewDepth)
# ---------- code_block.designscript (7 lines) ----------
//Z value calculation
//in accordance with the
//Centroid point
//Startingpoint of sectionview
-CropRegionOffset;
//Relative depth of sectionview
ViewDepth-CropRegionOffset;
# ----------------------------------------
byCoordinates = Point.ByCoordinates(x=maximumItem, y=maximumItem_2, z=code_block.out1)
VARmaxPoint = Output(byCoordinates)
byCoordinates_2 = Point.ByCoordinates(x=minimumItem, y=minimumItem_2, z=code_block.out0)
VARminPoint = Output(byCoordinates_2)
