# Dynamo custom node BK.Remove List from List by Item not Value.dyf (Dynamo 2.1.0.7500)
# category: Synthesize.Packages.Bakery.Core.List
# remove the items in ListA from the items in ListB and return whats left

VARListOfItemsToRemove = Input(VARListOfItemsToRemove: var[]..[])
VARListToRemoveFrom = Input(VARListToRemoveFrom: var[]..[])
python_script = Python(IN[0]=VARListOfItemsToRemove, IN[1]=VARListToRemoveFrom)
# ---------- python_script.python (13 lines) ----------
listA = IN[0]
listB = IN[1]
unmatched = []

#listC = [x for x in listA if x not in listB]
for x in range(len(listA)):
#	s = set(listA)
	if listA[x] in listB:
		listB.remove(listA[x])
	else:
		unmatched.append(listA[x])

OUT = [listB, unmatched]
# ----------------------------------------
code_block = CodeBlock { 0; }
getItemAtIndex = List.GetItemAtIndex(list=python_script, index=code_block)
VARreducedList = Output(getItemAtIndex)
code_block_2 = CodeBlock { 1; }
getItemAtIndex_2 = List.GetItemAtIndex(list=python_script, index=code_block_2)
VARunmatched = Output(getItemAtIndex_2)
