# Dynamo custom node BK.Remove Points with Duplicate XY Values.dyf (Dynamo 2.1.0.7500)
# category: Synthesize.Packages.Bakery.Geometry
# cleanup tool for points into Revit topography

VARpoints = Input(VARpoints: var[]..[])
code_block = CodeBlock { 0; }
bk_replace_point_z_value = Custom[BK.Replace Point Z Value](VARpoints=VARpoints, VARdesiredZvalue=code_block)
al_duplicate_item_indices = Custom[AL.Duplicate Item Indices](VARList=bk_replace_point_z_value)  # Searches an input list for duplicate entries and lists their index numbers. Couple with Get From List to delete duplicates from a list.
watch = Watch(al_duplicate_item_indices.VARDuplicateIndices)
removeItemAtIndex = List.RemoveItemAtIndex(list=VARpoints, indices=watch)
VARpointsCleaned = Output(removeItemAtIndex)
VARduplicateXYindices = Output(watch)
