# Dynamo custom node BK.Replace Item if True.dyf (Dynamo 2.1.0.7500)
# category: Synthesize.Packages.Bakery.Core.List
# takes two lists, plus a boolean list. If the boolean list says True, list1 item is replaced by list2 item

VARbooleanlist = Input(VARbooleanlist: var[])
code_block = CodeBlock { true; }
nullAllIndicesOf = Custom[SP.NullAllIndicesOf](VARlist=VARbooleanlist, VARvalue=code_block)  # list all of the indices of a list that match the specified value. Capable of handling null values, part of the SmartCopyMonitor workflow.
VARindicesReplaced = Output(nullAllIndicesOf)
VARlist1 = Input(VARlist1: var[]..[])
turnIntoList = Custom[CW.TurnIntoList](VARunknownItem=VARlist1)  # Turns an element (or a nested list) into a flat list
VARlist2 = Input(VARlist2: var[]..[])
turnIntoList_2 = Custom[CW.TurnIntoList](VARunknownItem=VARlist2)
getItemAtIndex = List.GetItemAtIndex(list=turnIntoList_2, index=nullAllIndicesOf)
replaceItemAtIndex = Custom[CW.List.ReplaceItemAtIndex+](VARseq=turnIntoList, VARindex=nullAllIndicesOf, VARreplacement=getItemAtIndex)  # Replaces the item at a given index (or list of indices) of a list by another item
VARnewList = Output(replaceItemAtIndex)
