# Dynamo custom node BK.Replace Point Z Value.dyf (Dynamo 2.1.0.7500)
# category: Synthesize.Packages.Bakery.Geometry

VARpoints = Input(VARpoints: var[]..[])
watch = Watch(VARpoints)
X = Point.X(point=watch)
Y = Point.Y(point=watch)
VARdesiredZvalue = Input(VARdesiredZvalue: var[]..[])
count = List.Count(list=X)
cycle = List.Cycle(list=VARdesiredZvalue, amount=count)
byCoordinates = Point.ByCoordinates(x=X, y=Y, z=cycle)
VARPoint = Output(byCoordinates)
