# Dynamo custom node BVN.IsString.dyf (Dynamo 2.1.0.7500)
# category: Synthesize.Packages.BVN.Core.Object
# Checks a list for input types and returns boolean value based on a string

VARlist = Input(VARlist: var[]..[])
python_script = Python(IN[0]=VARlist)
# ---------- python_script.python (9 lines) ----------
import clr
clr.AddReference('ProtoGeometry')
from Autodesk.DesignScript.Geometry import *
#The inputs to this node will be stored as a list in the IN variable.
list = IN[0]


#Assign your output to the OUT variable
OUT = list(isinstance(list, str) for value in values)
# ----------------------------------------
VARboolean = Output(python_script)
