# Dynamo custom node BVN.List.SortSublists.dyf (Dynamo 2.1.0.7500)
# category: Synthesize.Packages.BVN.Core.List
# Sorts sublists

# note: Copyright(c) 2017, Paul Wintour
# BVN, http://www.bvn.com.au/
# Licence: http://creativecommons.org/licenses/by-sa/4.0/
listToBeSorted = Input(listToBeSorted: var[]..[])  # Listtobesorted
otherList = Input(otherList: var[]..[])  # Otherlist
python_script = Python(IN[0]=listToBeSorted, IN[1]=otherList)
# ---------- python_script.python (23 lines) ----------
import clr
clr.AddReference('ProtoGeometry')
from Autodesk.DesignScript.Geometry import *

#The inputs to this node will be stored as a list in the IN variable.
sublistsToSortBy = IN[0]
otherSublists = IN[1]

sorted_sublistsToSortBy = []
sorted_otherSublists = []

for sublist, otherSublist in zip(sublistsToSortBy, otherSublists):
  # This calculates a list of pairs (sublistItem, otherSublistItem) sorted by sublistItem.
  sorted_sublists = sorted(zip(sublist, otherSublist), key=lambda item_pair: item_pair[0])
  
  # Build the output lists
  sorted_sublistsToSortBy.append(list(sublistItem for sublistItem, otherSublistItem in sorted_sublists))
  sorted_otherSublists.append(list(otherSublistItem for sublistItem, otherSublistItem in sorted_sublists))

outList = [sorted_sublistsToSortBy, sorted_otherSublists]

#Assign your output to the OUT variable
OUT = outList
# ----------------------------------------
code_block = CodeBlock { 0; }
getItemAtIndex = List.GetItemAtIndex(list=python_script, index=code_block)
VARsortedList = Output(getItemAtIndex)
code_block_2 = CodeBlock { 1; }
getItemAtIndex_2 = List.GetItemAtIndex(list=python_script, index=code_block_2)
VARsortedOtherList = Output(getItemAtIndex_2)
