# Dynamo custom node BVN.ModelGroup.TypeCollector.dyf (Dynamo 2.1.0.7500)
# category: Synthesize.Packages.BVN.Selection.Actions
# Returns all the types (not instances) from all model groups in the project

# note: Copyright(c) 2017, Paul Wintour
# BVN, http://www.bvn.com.au/
# Licence: http://creativecommons.org/licenses/by-sa/4.0/
python_script = Python()  # graph input
# ---------- python_script.python (33 lines) ----------
import clr
clr.AddReference('ProtoGeometry')
from Autodesk.DesignScript.Geometry import *

# Import DocumentManager
clr.AddReference('RevitServices')
import RevitServices
from RevitServices.Persistence import DocumentManager

# Import Revit API
clr.AddReference('RevitAPI')
import Autodesk.Revit.DB
from Autodesk.Revit.DB import *

# Import ToDSType(bool) extension method
clr.AddReference('RevitNodes')
import Revit
clr.ImportExtensions(Revit.Elements)

def GetModelGroupTypes(doc):
  return list(
      modelGroupType.ToDSType(True) for modelGroupType in
      FilteredElementCollector(doc)
      .OfCategory(BuiltInCategory.OST_IOSModelGroups)
      .OfClass(GroupType)
    )

doc = DocumentManager.Instance.CurrentDBDocument

modelGroupTypes = GetModelGroupTypes(doc)

#Assign your output to the OUT variable.
OUT = modelGroupTypes
# ----------------------------------------
VARmodelGroupTypes = Output(python_script)
