# Dynamo custom node BVN.Room.CentreLocation.dyf (Dynamo 2.1.0.7500)
# category: Synthesize.Packages.BVN.Elements.Actions
# Moves room to the centroid of the room. If the centroid is outside of the room boundary, the room will remain in its current position. Based on the custom node by Modelical.

# note: Copyright(c) 2017, Paul Wintour
# BVN, http://www.bvn.com.au/
# Licence: http://creativecommons.org/licenses/by-sa/4.0/
VARtoggle = Input(VARtoggle: bool)  # BooleantoggletorefreshPythonnodes
lb_lunchbox_room_element = Custom[LB.LunchBox Room Element Collector](VARToggle=VARtoggle)  # Collects rooms from the Revit document
VARYesNoSyncParameter = Input(VARYesNoSyncParameter: var[]..[])
getParameterValueByName = Element.GetParameterValueByName(element=lb_lunchbox_room_element.VARElement, parameterName=VARYesNoSyncParameter)
code_block = CodeBlock { 1; }
eq = getParameterValueByName == code_block
filterByBoolMask = List.FilterByBoolMask(list=lb_lunchbox_room_element.VARElement, mask=eq)
filterByBoolMask_2 = List.FilterByBoolMask(list=lb_lunchbox_room_element.VARBoundaries, mask=eq)
byJoinedCurves = PolyCurve.ByJoinedCurves(curves=filterByBoolMask_2.in)
length = Curve.Length(curve=byJoinedCurves)
sortSublists = Custom[BVN.List.SortSublists](listToBeSorted=length, otherList=byJoinedCurves)  # Sorts sublists
lastItem = List.LastItem()  # unwired: list
map = List.Map(list=sortSublists.VARsortedOtherList, f_x=lastItem)
extrudeAsSolid = Curve.ExtrudeAsSolid(curve=map)
centroid = Solid.Centroid(solid=extrudeAsSolid)
startPoint = Curve.StartPoint(curve=map)
code_block_2 = CodeBlock(p1=centroid, p2=startPoint) { centroid = Autodesk.Point.ByCoordinates(p1.X, p1.Y, p2.Z); }
python_script = Python(IN[0]=filterByBoolMask.in, IN[1]=code_block_2)
# ---------- python_script.python (24 lines) ----------
import clr
clr.AddReference('RevitAPI')
from Autodesk.Revit.DB import *

clr.AddReference("RevitNodes")
import Revit
clr.ImportExtensions(Revit.GeometryConversion)

rooms = UnwrapElement(IN[0])
points = [x.ToXyz() for x in IN[1]]
#points = UnwrapElement(IN[1])
roomBools = []
count = 0
for r in rooms:
	try:
		if r.IsPointInRoom(points[count]):
			roomBools.append(True)
		else:
			roomBools.append(False)
	except:
		roomBools.append(False)
	count = count + 1

OUT = roomBools
# ----------------------------------------
end = Revit.Transaction.Transaction.End(input=python_script)
filterByBoolMask_3 = List.FilterByBoolMask(list=filterByBoolMask.in, mask=end)
flatten = List.Flatten(list=filterByBoolMask_3.in)
filterByBoolMask_4 = List.FilterByBoolMask(list=code_block_2, mask=end)
flatten_2 = List.Flatten(list=filterByBoolMask_4.in)
python_script_2 = Python(IN[0]=flatten, IN[1]=flatten_2)
# ---------- python_script_2.python (38 lines) ----------
import clr
clr.AddReference('ProtoGeometry')
from Autodesk.DesignScript.Geometry import *

import clr
clr.AddReference('RevitAPI') 
clr.AddReference('RevitAPIUI') 
from Autodesk.Revit.DB import *

clr.AddReference("RevitServices")
import RevitServices
from RevitServices.Persistence import DocumentManager

clr.AddReference("RevitNodes")
import Revit
clr.ImportExtensions(Revit.GeometryConversion)

doc = DocumentManager.Instance.CurrentDBDocument
 
#The inputs to this node will be stored as a list in the IN variables.
rooms = UnwrapElement(IN[0])
points = [x.ToXyz() for x in IN[1]]
locations = []
count = 0


t = Transaction(doc, 'Move Room Location')
t.Start()
	
for r in rooms:
	P = points[count] - r.Location.Point
	r.Location.Move(P)
	count = count + 1

t.Commit()

#Assign your output to the OUT variable.
OUT = rooms
# ----------------------------------------
VARroomsMoved = Output(python_script_2)
VARroomsNotMoved = Output(flatten_2)
