# Dynamo custom node BVN.RoomTag.MoveToRoomLocation.dyf (Dynamo 2.1.0.7500)
# category: Synthesize.Packages.BVN.Elements.Actions
# Moves room tags to the room location point. Use the Room.CentreLocation node first before using this node. Based on the script by Modelical.

# note: gets all room tags
# note: Copyright(c) 2017, Paul Wintour
# BVN, http://www.bvn.com.au/
# Licence: http://creativecommons.org/licenses/by-sa/4.0/
# Description: Moves room tags to the the room location point. Based on the script by Modelical.
element_types = ElementTypes("SpatialElementTag")  # graph input
VARtoggle = Input(VARtoggle: bool)  # BooleantoggletorefreshPythonnode
filterByBoolMask = List.FilterByBoolMask(list=element_types, mask=VARtoggle)
all_elements_of_type = ElementsOfType(element_type=filterByBoolMask.in)
getCategory = Element.GetCategory(element=all_elements_of_type)
string_from_object = FromObject(obj=getCategory)
code_block = CodeBlock { "Room Tags"; }
boolean = BoolSelector(true)  # graph input
contains = String.Contains(str=string_from_object, searchFor=code_block, ignoreCase=boolean)
filterByBoolMask_2 = List.FilterByBoolMask(list=all_elements_of_type, mask=contains)
flatten = List.Flatten(list=filterByBoolMask_2.in)
VARRooms = Input(VARRooms: var[]..[])
# note: Based on the script by Modelical
# Edited By Karam Baki
python_script_bvn = Python(IN[0]=flatten, IN[1]=VARRooms)
# ---------- python_script_bvn.python (54 lines) ----------
import clr
clr.AddReference('ProtoGeometry')
from Autodesk.DesignScript.Geometry import *

import clr
clr.AddReference('RevitAPI') 
clr.AddReference('RevitAPIUI') 
from Autodesk.Revit.DB import *

clr.AddReference("RevitServices")
import RevitServices
from RevitServices.Persistence import DocumentManager
from RevitServices.Transactions import TransactionManager

clr.AddReference("RevitNodes")
import Revit
clr.ImportExtensions(Revit.GeometryConversion)

doc = DocumentManager.Instance.CurrentDBDocument
 
#The inputs to this node will be stored as a list in the IN variables.
rtags = UnwrapElement(IN[0])
rooms = UnwrapElement(IN[1])


tagsid = []
for each in rtags:
	tagsid.append(each.Room.Id)

roomsid = []
for each in rooms:
	roomsid.append(each.Id)

filteredtags = []

count = 0
for each in tagsid:
	for e in roomsid:
		if each == e:
			filteredtags.append(rtags[count])
		else: pass
	count = count + 1

TransactionManager.Instance.EnsureInTransaction(doc)

for rt in filteredtags:
	if rt.Room != None:
		rt.Location.Move(rt.Room.Location.Point - rt.Location.Point)

# End Transaction
TransactionManager.Instance.TransactionTaskDone()

#Assign your output to the OUT variable.
OUT = filteredtags
# ----------------------------------------
VARroomTags = Output(python_script_bvn)
