# Dynamo custom node BVN.View.Phase.dyf (Dynamo 2.1.0.7500)
# category: Synthesize.Packages.BVN.View.Query
# Returns the current view's phase

# note: Copyright(c) 2017, Paul Wintour
# BVN, http://www.bvn.com.au/
# Licence: http://creativecommons.org/licenses/by-sa/4.0/
current = Document.Current()
activeView = Document.ActiveView(document=current)
python_script = Python(IN[0]=activeView)
# ---------- python_script.python (19 lines) ----------
#gets the phase of the current view 
#copyright 2015 Paul Wintour & Dan Rumery / BVN


import clr
clr.AddReference('RevitAPI')
from Autodesk.Revit.DB import *

clr.AddReference("RevitServices")
import RevitServices
from RevitServices.Persistence import DocumentManager

doc = DocumentManager.Instance.CurrentDBDocument

view = IN[0]

phaseId = view.InternalElement.get_Parameter(BuiltInParameter.VIEW_PHASE).AsElementId()
		
OUT = doc.GetElement(phaseId)
# ----------------------------------------
VARphase = Output(python_script)
