# Dynamo custom node BVN.Window.RenumberByRoom.dyf (Dynamo 2.1.0.7500)
# category: Synthesize.Packages.BVN.Elements
# Renumbers a window's mark value based on the room it is located in. If there is no 'To' room, it will default to the 'From' room.

# note: Copyright(c) 2017, Paul Wintour
# BVN, http://www.bvn.com.au/
# Licence: http://creativecommons.org/licenses/by-sa/4.0/
categories = Categories("OST_Windows")  # graph input
all_elements_of_category = ElementsOfCategory(Category=categories)
# note: From BVN
phase = Custom[BVN.View.Phase]()  # Returns the current view's phase
# note: From clockwork package
rooms = Custom[CW.Window.Rooms](VARwindow=all_elements_of_category, VARphase=phase)  # Gets the rooms that are connected by a given window
code_block = CodeBlock { 0; }
eq = rooms.VARroomCount == code_block
# note: to room
filterByBoolMask = List.FilterByBoolMask(list=rooms.VARtoRoom, mask=eq)
# note: from room
filterByBoolMask_2 = List.FilterByBoolMask(list=rooms.VARfromRoom, mask=eq)
create = List.Create(item0=filterByBoolMask.out, item1=filterByBoolMask_2.out)
transpose = List.Transpose(lists=create)
boolean = BoolSelector(false)  # graph input
# note: Each window' to & from room
clean = List.Clean(list=transpose, preserveIndices=boolean)
# note: Get room to be included in window renumbering
firstItem = List.FirstItem(list=clean@L2)
id = Element.Id(element=firstItem)
# note: Filters any which don't have rooms
# note: windows
filterByBoolMask_3 = List.FilterByBoolMask(list=all_elements_of_category, mask=eq)
# note: group rooms so that door numbering can be grouped
create_2 = List.Create(item0=firstItem, item1=id, item2=filterByBoolMask_3.out)
code_block_2 = CodeBlock { 1; false; true; }
sortListOfLists = Custom[CW.List.SortListOfLists](VARseq=create_2, VARsortIndex=code_block_2.out0, VARcaseInsensitive=code_block_2.out1, VARorderDescending=code_block_2.out2)  # Sorts a list of lists by one of its sublists
code_block_3 = CodeBlock { 1; }
groupListOfListsByKey = Custom[CW.List.GroupListOfListsByKey](VARseq=sortListOfLists, VARkeyIndex=code_block_3)  # Groups a list of lists by one of its keys
# note: gets rooms
firstItem_2 = List.FirstItem(list=groupListOfListsByKey@@L3)
boolean_2 = BoolSelector(false)  # graph input
clean_2 = List.Clean(list=firstItem_2, preserveIndices=boolean_2)
firstItem_3 = List.FirstItem(list=clean_2@L2)
centerBoundary = Room.CenterBoundary(room=firstItem_3)
byJoinedCurves = PolyCurve.ByJoinedCurves(curves=centerBoundary)
firstItem_4 = List.FirstItem(list=byJoinedCurves@L2)
count = List.Count(list=clean_2@L2)
ofRepeatedItem = List.OfRepeatedItem(item=firstItem_4, amount=count, lacing=Longest)
code_block_4 = CodeBlock { 2; }
# note: gets windows
getItemAtIndex = List.GetItemAtIndex(list=groupListOfListsByKey@L3, index=code_block_4)
clean_3 = List.Clean(list=getItemAtIndex, preserveIndices=boolean_2)
# note: From Archi-lab. Gets room location. Required as API does not return location of curtain panel doors.
al_transform_origin = Custom[AL.Transform Origin](VARElement=clean_3@L2)  # This node will query an element for its Transform (Coordinate System) and then return its Origin point.
closestPointTo = Geometry.ClosestPointTo(geometry=ofRepeatedItem, other=al_transform_origin)
parameterAtPoint = Curve.ParameterAtPoint(curve=ofRepeatedItem, point=closestPointTo)
VARtoggle = Input(VARtoggle: bool)
# note: Sorts values. last import only dummy so Python script can re-run without if room numbers change
python_script = Python(IN[0]=parameterAtPoint, IN[1]=clean_2, IN[2]=clean_3, IN[3]=VARtoggle)
# ---------- python_script.python (33 lines) ----------
# Copyright(c) 2015, Dan Rumery
# BVN, http://www.bvn.com.au/
# Licence: http://creativecommons.org/licenses/by-sa/4.0/


import clr
clr.AddReference('ProtoGeometry')
from Autodesk.DesignScript.Geometry import *

#The inputs to this node will be stored as a list in the IN variable.
parameters = IN[0]
rooms = IN[1]
doors = IN[2]

sorted_params = []
sorted_rooms = []
sorted_doors = []

for rs, ds, ps in zip(rooms, doors, parameters):
  room = rs[0]
  
  # This calculates a list of pairs (param, door) sorted by param.
  sorted_params_and_doors = sorted(zip(ps, ds), key=lambda param_and_door: param_and_door[0])
  
  # Build the output lists
  sorted_rooms.append(rs) # No need to sort the rooms
  sorted_doors.append(list(door for param, door in sorted_params_and_doors))
  sorted_params.append(list(param for param, door in sorted_params_and_doors))

outList = [sorted_params, sorted_rooms, sorted_doors]

#Assign your output to the OUT variable
OUT = outList
# ----------------------------------------
code_block_5 = CodeBlock { 2; }
# note: sorted windows
getItemAtIndex_2 = List.GetItemAtIndex(list=python_script, index=code_block_5)
# note: reverse list to get clockwise numbering
reverse = List.Reverse(list=getItemAtIndex_2@L2)
flatten = List.Flatten(list=reverse)
string = StringInput("Mark")  # graph input
code_block_6 = CodeBlock { ""; }
join = String.Join(separator=code_block_6)  # unwired: string0, string1
markPrefix = Input(markPrefix: string = "W")  # prefixofmarkvalue
string_from_object = FromObject(obj=markPrefix)
length = String.Length(str=string_from_object)
# note: conditional statement
formula = Formula("LENGTH > 0", length=length)
VARReverseNumbering = Input(VARReverseNumbering: var[]..[])
code_block_7 = CodeBlock { 1; }
# note: sorted rooms
getItemAtIndex_3 = List.GetItemAtIndex(list=python_script, index=code_block_7)
string_2 = StringInput("Number")  # graph input
# note: gets room number
getParameterValueByName = Element.GetParameterValueByName(element=getItemAtIndex_3, parameterName=string_2)
string_from_object_2 = FromObject(obj=getParameterValueByName)
# note: Room number
flatten_2 = List.Flatten(list=string_from_object_2)
count_2 = List.Count(list=flatten_2)
ofRepeatedItem_2 = List.OfRepeatedItem(item=string_from_object, amount=count_2)
getKeys = GetKeys(list=getParameterValueByName@L2)
# note: starts numbering at 1
code_block_8 = CodeBlock(a=getKeys) { a+1; }
# note: converts to string
string_from_object_3 = FromObject(obj=code_block_8)
# note: Door number sequence
flatten_3 = List.Flatten(list=string_from_object_3)
markSeparator = Input(markSeparator: string = ".")  # separator
string_from_object_4 = FromObject(obj=markSeparator)
# note: separator
ofRepeatedItem_3 = List.OfRepeatedItem(item=string_from_object_4, amount=count_2)
create_3 = List.Create(item0=ofRepeatedItem_2, item1=flatten_3, item2=ofRepeatedItem_3, item3=flatten_2)
# note: with prefix
create_4 = List.Create(item0=ofRepeatedItem_2, item1=flatten_2, item2=ofRepeatedItem_3, item3=flatten_3)
scopeIf = Custom[CW.ScopeIf+](VARtest=VARReverseNumbering, VARtrue=create_3, VARfalse=create_4)  # A (hopefully) more robust implementation of ScopeIf. Tests a single boolean and returns a value accordingly.
transpose_2 = List.Transpose(lists=scopeIf)
concat = String.Concat(string0=transpose_2)
# note: new number if true
flatten_4 = List.Flatten(list=concat)
create_5 = List.Create(item0=flatten_3, item1=ofRepeatedItem_3, item2=flatten_2)
# note: without prefix
create_6 = List.Create(item0=flatten_2, item1=ofRepeatedItem_3, item2=flatten_3)
scopeIf_2 = Custom[CW.ScopeIf+](VARtest=VARReverseNumbering, VARtrue=create_5, VARfalse=create_6)
transpose_3 = List.Transpose(lists=scopeIf_2)
concat_2 = String.Concat(string0=transpose_3)
# note: new number if false
flatten_5 = List.Flatten(list=concat_2)
scopeIf_3 = Custom[CW.ScopeIf+](VARtest=formula, VARtrue=flatten_4, VARfalse=flatten_5)
VARmarkSuffix = Input(VARmarkSuffix: var[]..[])
matchLength = Custom[LF.List.MatchLength](VARlistLength=scopeIf_3, VARlist=VARmarkSuffix)  # Cycle a list to match the length of the first list.
combine = List.Combine(comb=join, list1=scopeIf_3, list2=matchLength)
setParameterByName = Element.SetParameterByName(element=flatten, parameterName=string, value=combine)
VARrenumberedElements = Output(setParameterByName)
flatten_6 = List.Flatten(list=filterByBoolMask_3.in)
VARexcludedElements = Output(flatten_6)
