# Dynamo custom node Borders Panels.dyf (Dynamo 2.1.0.7500)
# category: Synthesize.Automate.Adaptive
# Map Revit Panels

VARTargetSurfaces = Input(VARTargetSurfaces: var[]..[])
flatten = List.Flatten(list=VARTargetSurfaces)
VARTollerance = Input(VARTollerance: double = 0.2)
VARBorderDetectionTollerance = Input(VARBorderDetectionTollerance: double = 1)
prepare_clean_pattern = Custom[Prepare Clean Pattern](VARFaces=flatten, VARTollerance=VARTollerance, VARBorderDetectionTollerance=VARBorderDetectionTollerance)  # Prepare Clean Pattern
python_script = Python(IN[0]=prepare_clean_pattern.VARFaultyPatternPoints, IN[1]=prepare_clean_pattern.VARBorderPatternPoints)
# ---------- python_script.python (24 lines) ----------
import clr
clr.AddReference('ProtoGeometry')
from Autodesk.DesignScript.Geometry import *
#The inputs to this node will be stored as a list in the IN variables.
dataEnteringNode = IN

list1 = UnwrapElement(IN[0])
list2 = UnwrapElement(IN[1])

resultall = []
count = 0
for l in list1:
	l2 = list2[count]
	tmp = []
	for k in l:
		if k != None:
			tmp.append(k)
	for k2 in l2:
		if k2 != None:
			tmp.append(k2)
	resultall.append(tmp)
	count += 1
#Assign your output to the OUT variable.
OUT = resultall
# ----------------------------------------
count = List.Count()  # unwired: list
sortByFunction = List.SortByFunction(list=python_script@@L3, func=count)
groupByFunction = List.GroupByFunction(list=sortByFunction@@L3, func=count)
count_2 = List.Count(list=groupByFunction@@L2)
firstItem = List.FirstItem(list=count_2@@L2)
transpose = List.Transpose(lists=firstItem)
firstItem_2 = List.FirstItem(list=transpose@L2)
string_from_object = FromObject(obj=firstItem_2)
code_block = CodeBlock { "."; }
split = String.Split(str=string_from_object, separator0=code_block)
firstItem_3 = List.FirstItem(list=split@L2)
count_3 = List.Count(list=count_2@@L2)
transpose_2 = List.Transpose(lists=count_3)
sum = Math.Sum(values=transpose_2@L2)
string_from_object_2 = FromObject(obj=sum)
string_from_object_3 = FromObject(obj=string_from_object_2)
code_block_2 = CodeBlock { "."; }
split_2 = String.Split(str=string_from_object_3, separator0=code_block_2)
firstItem_4 = List.FirstItem(list=split_2@L2)
python_script_2 = Python(IN[0]=firstItem_3, IN[1]=firstItem_4)
# ---------- python_script_2.python (32 lines) ----------
import clr
clr.AddReference('ProtoGeometry')
from Autodesk.DesignScript.Geometry import *
#The inputs to this node will be stored as a list in the IN variables.
dataEnteringNode = IN

strings = IN[0]
count = IN[1]

result = []
try:
	result.append(count[0] + " Primary Panels " + "With " + strings[0] + " Points")
except : pass

try:
	result.append(count[1] + " Secondary Panels " + "With " + strings[1] + " Points")
except : pass

try:
	result.append(count[2] + " Tertiary Panels " + "With " + strings[2] + " Points")
except : pass

try:
	result.append(count[3] + " Quaternary Panels " + "With " + strings[3] + " Points")
except : pass

try:
	result.append(count[4] + " Quinary Panels " + "With " + strings[4] + " Points")
except : pass

#Assign your output to the OUT variable.
OUT = result
# ----------------------------------------
VARReport = Output(python_script_2)
code_block_3 = CodeBlock { 0; 1; 2; 3; 4; }
getItemAtIndex = List.GetItemAtIndex(list=groupByFunction@L4, index=code_block_3.out0)
code_block_4 = CodeBlock { false; }
clean = List.Clean(list=getItemAtIndex, preserveIndices=code_block_4)
VARPrimary = Output(clean)
getItemAtIndex_2 = List.GetItemAtIndex(list=groupByFunction@L4, index=code_block_3.out1)
clean_2 = List.Clean(list=getItemAtIndex_2, preserveIndices=code_block_4)
VARSecondary = Output(clean_2)
getItemAtIndex_3 = List.GetItemAtIndex(list=groupByFunction@L4, index=code_block_3.out2)
clean_3 = List.Clean(list=getItemAtIndex_3, preserveIndices=code_block_4)
VARTertiary = Output(clean_3)
getItemAtIndex_4 = List.GetItemAtIndex(list=groupByFunction@L4, index=code_block_3.out3)
clean_4 = List.Clean(list=getItemAtIndex_4, preserveIndices=code_block_4)
VARQuaternary = Output(clean_4)
getItemAtIndex_5 = List.GetItemAtIndex(list=groupByFunction@L4, index=code_block_3.out4)
clean_5 = List.Clean(list=getItemAtIndex_5, preserveIndices=code_block_4)
VARQuinary = Output(clean_5)
VARShowPolygons = Input(VARShowPolygons: var[]..[])
empty = List.Empty()
scopeIf = Custom[CW.ScopeIf+](VARtest=VARShowPolygons, VARtrue=groupByFunction, VARfalse=empty)  # A (hopefully) more robust implementation of ScopeIf. Tests a single boolean and returns a value accordingly.
byPoints = Polygon.ByPoints(points=scopeIf)
python_null_2_empty = Custom[Python Null 2 Empty](VARIN=byPoints)  # Python Null 2 Empty
VARPolygons = Output(python_null_2_empty)
VARSurfaces = Output(prepare_clean_pattern.VARFaces)
empty_2 = List.Empty()
flatten_2 = List.Flatten(list=prepare_clean_pattern.VARToDeletePatterns)
scopeIf_2 = Custom[CW.ScopeIf+](VARtest=VARShowPolygons, VARtrue=empty_2, VARfalse=flatten_2)
eraser = Custom[ST.Tool.Eraser](VARList=scopeIf_2)  # Try to delete any element from project
join = List.Join()  # unwired: list0, list1
empty_3 = List.Empty()
scopeIf_3 = Custom[CW.ScopeIf+](VARtest=VARShowPolygons, VARtrue=prepare_clean_pattern.VARInteriorPoints, VARfalse=empty_3)
byPoints_2 = Polygon.ByPoints(points=scopeIf_3)
combine = List.Combine(comb=join, list1=byPoints, list2=byPoints_2)
flatten_3 = List.Flatten(list=combine@L3)
VARALLPOLYGONS = Output(flatten_3)
