# Dynamo custom node Building Pad Type Selector.dyf (Dynamo 2.1.0.7500)
# category: Synthesize.Automate.Select
# Building Pad Type Selector

element_types = ElementTypes("BuildingPadType")
all_elements_of_type = ElementsOfType(element_type=element_types)
isEmpty = List.IsEmpty(list=all_elements_of_type)
python_script = Python(IN[0]=isEmpty)
# ---------- python_script.python (43 lines) ----------
import clr
#Import Revit Services
clr.AddReference ("RevitServices")
import RevitServices
from RevitServices.Persistence import DocumentManager
from RevitServices.Transactions import TransactionManager
#Import Revit API
clr.AddReference('RevitAPI')
from Autodesk.Revit.DB import *
from Autodesk.Revit.DB.Architecture import *
clr.AddReference('RevitAPIUI')
from Autodesk.Revit.UI import *
#Import Revit Node
clr.AddReference('RevitNodes')
import Revit
clr.ImportExtensions(Revit.GeometryConversion)
clr.ImportExtensions(Revit.Elements)
#Import Proto Geometry
clr.AddReference('ProtoGeometry')
from Autodesk.DesignScript.Geometry import *

import System
from System.Collections.Generic import *

test = IN[0]

#get the document
doc = DocumentManager.Instance.CurrentDBDocument

#use safe transaction with Revit

if test == 1 :
	TransactionManager.Instance.EnsureInTransaction(doc)
	try :
		defaultpad = BuildingPadType.CreateDefault(doc)
	except :
		defaultpad = None
else :
	defaultpad = None
#Finish transaction with task done
TransactionManager.Instance.TransactionTaskDone()

OUT = defaultpad
# ----------------------------------------
code_block = CodeBlock { "Type Name"; }
getParameterValueByName = Element.GetParameterValueByName(element=all_elements_of_type, parameterName=code_block)
VARBuildingPadTypeName = Input(VARBuildingPadTypeName: var[]..[])
eq = getParameterValueByName == VARBuildingPadTypeName
filterByBoolMask = List.FilterByBoolMask(list=all_elements_of_type, mask=eq)
create = List.Create(item0=python_script, item1=filterByBoolMask.in)
code_block_2 = CodeBlock { false; }
clean = List.Clean(list=create, preserveIndices=code_block_2)
flatten = List.Flatten(list=clean)
firstItem = List.FirstItem(list=flatten)
VARBuildingPadType = Output(firstItem)
isNull = Object.IsNull(obj=firstItem)
code_block_3 = CodeBlock { "ERROR, Incorrect Building Pad Type"; }
empty = List.Empty()
scopeIf = Custom[CW.ScopeIf+](VARtest=isNull, VARtrue=code_block_3, VARfalse=empty)  # A (hopefully) more robust implementation of ScopeIf. Tests a single boolean and returns a value accordingly.
alert_popup = Custom[Alert Popup](VARMessage=scopeIf)  # Popup a message dialog in Revit
