# Dynamo custom node CH.Point.Flatten.dyf (Dynamo 2.1.0.7500)
# category: Synthesize.Packages.Chynamo.Geometry.Point.Actions
# Project point's Z coordinate to certain number

# note: Chynamo Package DYF by Koz Jono YEOH
# kozmosovia@hotmail.com
# Copyright(C)1994-2017 KozMos Inc.
# Copyright(C) 2011-2017 Neila Heaven Networks
VARpoint = Input(VARpoint: Autodesk.DesignScript.Geometry.Point)
VARNewZ = Input(VARNewZ: double = 0)
code_block = CodeBlock(PTX=VARpoint, NewZ=VARNewZ) { Point.ByCoordinates(PTX.X, PTX.Y, NewZ); }
VARPoint = Output(code_block)
