# Dynamo custom node CH.Point.GetConvexHull.dyf (Dynamo 2.1.0.7500)
# category: Synthesize.Packages.Chynamo.Geometry.Point.Query
# Generate convex hull vertices of group of points

# note: Chynamo Package DYF by Koz Jono YEOH
# kozmosovia@hotmail.com
# Copyright(C)1994-2017 KozMos Inc.
# Copyright(C) 2011-2017 Neila Heaven Networks
# Licence: http://creativecommons.org/licenses/by-sa/4.0/
VARpoints = Input(VARpoints: Autodesk.DesignScript.Geometry.Point[])
flatten = Custom[CH.Point.Flatten](VARpoint=VARpoints)  # Project point's Z coordinate to certain number
convexHull2D = Python(IN[0]=flatten)  # "Point.ConvexHull2D"
# ---------- convexHull2D.python (35 lines) ----------
import clr
clr.AddReference('ProtoGeometry')
from Autodesk.DesignScript.Geometry import *
#该节点的输入内容将存储为 IN 变量中的一个列表。
ptx=IN[0]

def _cross(o, a, b):
	return (a[0] - o[0]) * (b[1] - o[1]) - (a[1] - o[1]) * (b[0] - o[0])
def _Get2DConvexHull(xpoints):	
	newpoints=[]
	for pair in xpoints:
		newpoint = (pair.X,pair.Y)
		newpoints.append(newpoint)
	points = sorted(set(newpoints))
	if len(points) <= 1:
		return points
	else:
		lower = []		
		upper = []
		for p in points:
			while len(lower) >= 2 and _cross(lower[-2], lower[-1], p) <= 0:
				lower.pop()
			lower.append(p)
		for p in reversed(points):
			while len(upper) >= 2 and _cross(upper[-2], upper[-1], p) <= 0:
				upper.pop()
			upper.append(p)
		return lower[:-1] + upper[:-1]

rtn=[]
for abc in _Get2DConvexHull(ptx):
	rtn.append(Point.ByCoordinates(abc[0], abc[1], 0))
	
#将输出内容指定给 OUT 变量。
OUT=rtn
# ----------------------------------------
VAR2DPoints = Output(convexHull2D)
firstIndexOf = List.FirstIndexOf(list=flatten)  # unwired: item
map = List.Map(list=convexHull2D, f_x=firstIndexOf)
getItemAtIndex = List.GetItemAtIndex(list=VARpoints, index=map)
VAR3DPoints = Output(getItemAtIndex)
