# Dynamo custom node CW.All Elements of Family Type+.dyf (Dynamo 2.1.0.7500)
# category: Synthesize.Packages.Clockwork.Revit.Selection.ByCollector
# Unlike the built-in  node, this node retrieves all placed instances of a given loadable *or* system family type

VARfamilyType = Input(VARfamilyType: var[]..[])
turnIntoList = Custom[CW.TurnIntoList](VARunknownItem=VARfamilyType)  # Turns an element (or a nested list) into a flat list
VARtoggle = Input(VARtoggle: bool = true)
python_script = Python(IN[0]=turnIntoList, IN[1]=VARtoggle)
# ---------- python_script.python (26 lines) ----------
import System
import clr
clr.AddReference('RevitAPI')
from Autodesk.Revit.DB import *

clr.AddReference("RevitServices")
import RevitServices
from RevitServices.Persistence import DocumentManager

doc = DocumentManager.Instance.CurrentDBDocument
famtypes = UnwrapElement(IN[0])

elementlist = list()
for ft in famtypes:
	collector = FilteredElementCollector(doc)
	bic = System.Enum.ToObject(BuiltInCategory, ft.Category.Id.IntegerValue)
	collector.OfCategory(bic)
	# This is a workaround
	# because I was to lazy to learn
	# how to implement LINQ in Python
	ftlist =  list()
	for item in collector.ToElements():
		if item.GetTypeId().IntegerValue == ft.Id.IntegerValue:
			ftlist.append(item)
	elementlist.append(ftlist)
OUT = elementlist
# ----------------------------------------
returnListOrSingleValue = Custom[CW.ReturnListOrSingleValue](VARunknownItem=VARfamilyType, VARseq=python_script)  # If the unknown item is not a list but rather a single item, only the first item of the list (input "seq") will be returned.
VARelements = Output(returnListOrSingleValue)
