# Dynamo custom node CW.All Family Types Of Category.dyf (Dynamo 2.1.0.7500)
# category: Synthesize.Packages.Clockwork.Revit.Selection.ByCollector
# Gets all family types/symbols of a given category in the model  (does *not *work for system families)

VARcategory = Input(VARcategory: Revit.Elements.Category)
turnIntoList = Custom[CW.TurnIntoList](VARunknownItem=VARcategory)  # Turns an element (or a nested list) into a flat list
boolean = BoolSelector(true)  # graph input
python_script = Python(IN[0]=turnIntoList, IN[1]=boolean)
# ---------- python_script.python (21 lines) ----------
import System
import clr
clr.AddReference('RevitAPI')
from Autodesk.Revit.DB import *

clr.AddReference("RevitServices")
import RevitServices
from RevitServices.Persistence import DocumentManager

doc = DocumentManager.Instance.CurrentDBDocument
cats = IN[0]

elementlist = list()
# This could be more elegant if only I knew how to implement a Multicategory filter in Python....
for item in cats:
	collector = FilteredElementCollector(doc)
	collector.OfClass(FamilySymbol)
	bic = System.Enum.ToObject(BuiltInCategory, item.Id)
	collector.OfCategory(bic)
	elementlist.append(collector.ToElements())
OUT = elementlist
# ----------------------------------------
returnListOrSingleValue = Custom[CW.ReturnListOrSingleValue](VARunknownItem=VARcategory, VARseq=python_script)  # If the unknown item is not a list but rather a single item, only the first item of the list (input "seq") will be returned.
VARfamilyTypes = Output(returnListOrSingleValue)
