# Dynamo custom node CW.Application.Version.dyf (Dynamo 2.1.0.7500)
# category: Synthesize.Packages.Clockwork.Revit.Application.Query
# Retrieves the name, version and build of the current Revit application.

python_script = Python()  # unwired: IN[0]
# ---------- python_script.python (10 lines) ----------
import clr
clr.AddReference("RevitServices")
import RevitServices
from RevitServices.Persistence import DocumentManager

doc = DocumentManager.Instance.CurrentDBDocument
uiapp = DocumentManager.Instance.CurrentUIApplication
app = uiapp.Application

OUT = app.VersionName, app.VersionNumber, app.VersionBuild, app.Language
# ----------------------------------------
code_block = CodeBlock(seq=python_script) { seq[0]; seq[1]; seq[2]; seq[3]; }
VARName = Output(code_block.out0)
VARVersionint = Output(code_block.out1)
VARBuild = Output(code_block.out2)
VARLanguage = Output(code_block.out3)
