# Dynamo custom node CW.Directory.ContentsAll.dyf (Dynamo 2.1.0.7500)
# category: Synthesize.Packages.Clockwork.Core.Directory.Query
# Unlike the built-in node Directory.Contents, this node browses a directory recursively and returns all relevant files contained in subfolders as well.

VARdirectoryPath = Input(VARdirectoryPath: string)
VARsearchString = Input(VARsearchString: string = "*")
python_script = Python(IN[0]=VARdirectoryPath, IN[1]=VARsearchString)
# ---------- python_script.python (7 lines) ----------
from System.IO import Directory, SearchOption
dir = IN[0]
searchstring = IN[1]
if Directory.Exists(dir):
	OUT = Directory.GetFiles(dir, searchstring, SearchOption.AllDirectories)
else:
	OUT = list()
# ----------------------------------------
VARfiles = Output(python_script)
