# Dynamo custom node CW.DisplayUnit.ToInternalUnit.dyf (Dynamo 2.1.0.7500)
# category: Synthesize.Packages.Clockwork.Revit.Units.Actions
# Converts a value from a given display unit to Revit's internal unit

VARval = Input(VARval: var[]..[])
turnIntoList = Custom[CW.TurnIntoList](VARunknownItem=VARval)  # Turns an element (or a nested list) into a flat list
VARdisplayUnitType = Input(VARdisplayUnitType: var[]..[])
python_script = Python(IN[0]=turnIntoList, IN[1]=VARdisplayUnitType)
# ---------- python_script.python (10 lines) ----------
import clr
clr.AddReference('RevitAPI')
from Autodesk.Revit.DB import *

vals = IN[0]
dispunit = IN[1]
elementlist = []
for val in vals:
	elementlist.append(UnitUtils.ConvertToInternalUnits(val,dispunit))
OUT = elementlist
# ----------------------------------------
returnListOrSingleValue = Custom[CW.ReturnListOrSingleValue](VARunknownItem=VARval, VARseq=python_script)  # If the unknown item is not a list but rather a single item, only the first item of the list (input "seq") will be returned.
VARval_2 = Output(returnListOrSingleValue)  # "VARval"
