# Dynamo custom node CW.DividedPath.SetIntersect.dyf (Dynamo 2.1.0.7500)
# category: Synthesize.Packages.Clockwork.Revit.Elements.DividedSurface.Actions
# Adds an intersect to a divided surface

VARdividedPath = Input(VARdividedPath: var[]..[])
VARelement = Input(VARelement: var[]..[])
turnIntoList = Custom[CW.TurnIntoList](VARunknownItem=VARelement)  # Turns an element (or a nested list) into a flat list
python_script = Python(IN[0]=VARdividedPath, IN[1]=turnIntoList)
# ---------- python_script.python (30 lines) ----------
import clr
clr.AddReference('RevitAPI')
from Autodesk.Revit.DB import *

clr.AddReference("RevitServices")
import RevitServices
from RevitServices.Persistence import DocumentManager
from RevitServices.Transactions import TransactionManager

clr.AddReference("System")
from System.Collections.Generic import List

doc = DocumentManager.Instance.CurrentDBDocument
divsurf = UnwrapElement(IN[0])
intersects = UnwrapElement(IN[1])

TransactionManager.Instance.EnsureInTransaction(doc)
tmplist = []
for item in intersects:
	idpure = item.Id
	tmplist.append(idpure)
	try:
		converted = List[ElementId](tmplist)
		divsurf.SetIntersectingElements(converted)
	except:
		pass
	
TransactionManager.Instance.TransactionTaskDone()

OUT = divsurf
# ----------------------------------------
VARdividedPath_2 = Output(python_script)  # "VARdividedPath"
