# Dynamo custom node CW.Document.BuiltInParameters.dyf (Dynamo 2.1.0.7500)
# category: Synthesize.Packages.Clockwork.Revit.Document.Query
# List all the available BuiltInParameters

python_script = Python()  # graph input
# ---------- python_script.python (15 lines) ----------
import clr
import System
clr.AddReference('RevitAPI')
clr.AddReference('RevitAPIUI')
from Autodesk.Revit.DB import *
import Autodesk

bips = System.Enum.GetValues(BuiltInParameter)
pdata = list()
for bip in bips:
	try:
		pdata.append((bip,ElementId(bip),LabelUtils.GetLabelFor(bip)))
	except:
		pass
OUT = pdata
# ----------------------------------------
transpose = List.Transpose(lists=python_script)
code_block = CodeBlock(seq=transpose) { seq[0]; seq[1]; seq[2]; }
VARBuiltInParameters = Output(code_block.out0)
VARElementIDs = Output(code_block.out1)
VARParameterNames = Output(code_block.out2)
