# Dynamo custom node CW.Document.ProjectInfo.dyf (Dynamo 2.1.0.7500)
# category: Synthesize.Packages.Clockwork.Revit.Document.Query
# Gets the project information.

VARtoggle = Input(VARtoggle: bool = true)
python_script = Python(IN[0]=VARtoggle)
# ---------- python_script.python (23 lines) ----------
import clr
clr.AddReference("RevitServices")
import RevitServices
from RevitServices.Persistence import DocumentManager

doc = DocumentManager.Instance.CurrentDBDocument
elementlist = list()
projinfo = doc.ProjectInformation
elementlist.append(projinfo.OrganizationName)
elementlist.append(projinfo.OrganizationDescription)
elementlist.append(projinfo.BuildingName)
# this property seems to be missing in some files - weird...
try:
	elementlist.append(projinfo.Author)
except:
	elementlist.append(list())
elementlist.append(projinfo.IssueDate)
elementlist.append(projinfo.Status)
elementlist.append(projinfo.ClientName)
elementlist.append(projinfo.Address)
elementlist.append(projinfo.Name)
elementlist.append(projinfo.Number)
OUT = elementlist
# ----------------------------------------
code_block = CodeBlock(seq=python_script) { seq[0]; seq[1]; seq[2]; seq[3]; seq[4]; seq[5]; seq[6]; seq[7]; seq[8]; seq[9]; }
VAROrganizationName = Output(code_block.out0)
VAROrganizationDescription = Output(code_block.out1)
VARBuildingName = Output(code_block.out2)
VARAuthor = Output(code_block.out3)
VARIssueDate = Output(code_block.out4)
VARStatus = Output(code_block.out5)
VARClientName = Output(code_block.out6)
VARAddress = Output(code_block.out7)
VARName = Output(code_block.out8)
VARNumber = Output(code_block.out9)
