# Dynamo custom node CW.Door.Rooms.dyf (Dynamo 2.1.0.7500)
# category: Synthesize.Packages.Clockwork.Revit.Elements.Door.Query
# Gets the rooms that are connected by a given door

VARdoor = Input(VARdoor: Revit.Elements.FamilyInstance)
turnIntoList = Custom[CW.TurnIntoList](VARunknownItem=VARdoor)  # Turns an element (or a nested list) into a flat list
VARphase = Input(VARphase: var[]..[])
python_script = Python(IN[0]=turnIntoList, IN[1]=VARphase)
# ---------- python_script.python (28 lines) ----------
import clr
clr.AddReference('RevitAPI')
from Autodesk.Revit.DB import *

items = UnwrapElement(IN[0])
phase = UnwrapElement(IN[1])
fromlist = list()
tolist = list()
numexits = list()

for item in items:
	exits = 0
	try:	
		if item.FromRoom[phase]:
			fromlist.append(item.FromRoom[phase])
			exits += 1
		else:
			fromlist.append(list())
		if item.ToRoom[phase]:
			tolist.append(item.ToRoom[phase])
			exits += 1
		else:
			tolist.append(list())
	except:
		fromlist.append(list())
		tolist.append(list())
	numexits.append(exits)
OUT = (fromlist,tolist,numexits)
# ----------------------------------------
code_block = CodeBlock(seq=python_script) { seq[0]; seq[1]; seq[2]; }
returnListOrSingleValue = Custom[CW.ReturnListOrSingleValue](VARunknownItem=VARdoor, VARseq=code_block.out0)  # If the unknown item is not a list but rather a single item, only the first item of the list (input "seq") will be returned.
VARfromRoom = Output(returnListOrSingleValue)
returnListOrSingleValue_2 = Custom[CW.ReturnListOrSingleValue](VARunknownItem=VARdoor, VARseq=code_block.out1)
VARtoRoom = Output(returnListOrSingleValue_2)
returnListOrSingleValue_3 = Custom[CW.ReturnListOrSingleValue](VARunknownItem=VARdoor, VARseq=code_block.out2)
VARroomCount = Output(returnListOrSingleValue_3)
