# Dynamo custom node CW.Duplicate Family Types.dyf (Dynamo 2.1.0.7500)
# category: Synthesize.Packages.Clockwork.Revit.Elements.ElementType.Actions
# Duplicates an element type

VARElementTypes = Input(VARElementTypes: var[]..[])
turnIntoList = Custom[CW.TurnIntoList](VARunknownItem=VARElementTypes)  # Turns an element (or a nested list) into a flat list
VARNames = Input(VARNames: var[]..[])
turnIntoList_2 = Custom[CW.TurnIntoList](VARunknownItem=VARNames)
code_block = CodeBlock(types=turnIntoList, names=turnIntoList_2) { [types,names]; }
equalSublistLengths = Custom[CW.List.EqualSublistLengths](VARlists=code_block)  # Trims all given lists to the length of the shortest list
code_block_2 = CodeBlock(seq=equalSublistLengths) { seq[0]; seq[1]; }
python_script = Python(IN[0]=code_block_2.out0, IN[1]=code_block_2.out1)
# ---------- python_script.python (27 lines) ----------
import clr
clr.AddReference('RevitAPI')
from Autodesk.Revit.DB import *

clr.AddReference("RevitNodes")
import Revit
clr.ImportExtensions(Revit.Elements)

clr.AddReference("RevitServices")
import RevitServices
from RevitServices.Persistence import DocumentManager
from RevitServices.Transactions import TransactionManager

doc = DocumentManager.Instance.CurrentDBDocument
famtypes = UnwrapElement(IN[0])
newnames = IN[1]
elementlist = list()
counter = 0
TransactionManager.Instance.EnsureInTransaction(doc)
for item in famtypes:
	try:
		elementlist.append(item.Duplicate(newnames[counter]))
	except:
		elementlist.append(list())
	counter += 1
TransactionManager.Instance.TransactionTaskDone()
OUT = elementlist
# ----------------------------------------
returnListOrSingleValue = Custom[CW.ReturnListOrSingleValue](VARunknownItem=VARElementTypes, VARseq=python_script)  # If the unknown item is not a list but rather a single item, only the first item of the list (input "seq") will be returned.
VARDuplicates = Output(returnListOrSingleValue)
