# Dynamo custom node CW.Element.ByID.dyf (Dynamo 2.1.0.7500)
# category: Synthesize.Packages.Clockwork.Revit.Selection.Miscellaneous
# Gets the Revit element(s) for a list of IDs (or a single ID). Optionally retrieves elements from linked documents as well.

VARIDUniqueId = Input(VARIDUniqueId: var[]..[])
VARdocOrRevitLinkInstance = Input(VARdocOrRevitLinkInstance: var = null)
python_script = Python(IN[0]=VARIDUniqueId, IN[1]=VARdocOrRevitLinkInstance)
# ---------- python_script.python (30 lines) ----------
import clr
clr.AddReference('RevitAPI')
from Autodesk.Revit.DB import *

clr.AddReference("RevitNodes")
import Revit
clr.ImportExtensions(Revit.Elements)

clr.AddReference("RevitServices")
import RevitServices
from RevitServices.Persistence import DocumentManager

def ElementById(item, doc):
	try: 
		return doc.GetElement(item).ToDSType(True)
	except:
		try:
			return doc.GetElement(ElementId(item)).ToDSType(True)
		except:
			return None

items = UnwrapElement(IN[0])
inputdoc = UnwrapElement(IN[1])
if not inputdoc: doc = DocumentManager.Instance.CurrentDBDocument
elif inputdoc.GetType().ToString() == "Autodesk.Revit.DB.RevitLinkInstance": doc = inputdoc.GetLinkDocument()
elif inputdoc.GetType().ToString() == "Autodesk.Revit.DB.Document": doc = inputdoc
else: doc = DocumentManager.Instance.CurrentDBDocument

if isinstance(IN[0], list): OUT = [ElementById(x, doc) for x in items]
else: OUT = ElementById(items, doc)
# ----------------------------------------
VARelement = Output(python_script)
