# Dynamo custom node CW.Element.FromDynamoSurface.dyf (Dynamo 2.1.0.7500)
# category: Synthesize.Packages.Clockwork.Revit.Selection.ByFace
# Returns the underlying Revit element of a given face

VARDynamoSurface = Input(VARDynamoSurface: var[]..[])
turnIntoList = Custom[CW.TurnIntoList](VARunknownItem=VARDynamoSurface)  # Turns an element (or a nested list) into a flat list
python_script = Python(IN[0]=turnIntoList)
# ---------- python_script.python (19 lines) ----------
import clr
clr.AddReference('RevitAPI')
from Autodesk.Revit.DB import *

clr.AddReference("RevitServices")
import RevitServices
from RevitServices.Persistence import DocumentManager

doc = DocumentManager.Instance.CurrentDBDocument
faces = UnwrapElement(IN[0])
elementlist = list()
for face in faces:
	try:
		ref = face.Tags.LookupTag("RevitFaceReference")
		elem = doc.GetElement(ref)
		elementlist.append(elem)
	except:
		elementlist.append(list())
OUT = elementlist
# ----------------------------------------
VARelement = Output(python_script)
