# Dynamo custom node CW.Element.ID.dyf (Dynamo 2.1.0.7500)
# category: Synthesize.Packages.Clockwork.Revit.Elements.Element.Query
# Gets the ID(s) for a list of Revit elements (or a single element) - unlike the built-in Element.Id node, this node returns an actual Revit Element ID and *not* a number

VARelement = Input(VARelement: var[]..[])
turnIntoList = Custom[CW.TurnIntoList](VARunknownItem=VARelement)  # Turns an element (or a nested list) into a flat list
python_script = Python(IN[0]=turnIntoList)
# ---------- python_script.python (19 lines) ----------
import clr
clr.AddReference('RevitAPI')
from Autodesk.Revit.DB import *

clr.AddReference("RevitNodes")
import Revit
clr.ImportExtensions(Revit.Elements)

items = UnwrapElement(IN[0])
elementlist = list()
booleans = list()
for item in items:
	try:
		elementlist.append(item.Id)
		booleans.append(True)
	except:
		elementlist.append(None)
		booleans.append(False)
OUT = (elementlist, booleans)
# ----------------------------------------
code_block = CodeBlock(seq=python_script) { seq[0]; seq[1]; }
returnListOrSingleValue = Custom[CW.ReturnListOrSingleValue](VARunknownItem=VARelement, VARseq=code_block.out0)  # If the unknown item is not a list but rather a single item, only the first item of the list (input "seq") will be returned.
VARID = Output(returnListOrSingleValue)
VARbool = Output(code_block.out1)
