# Dynamo custom node CW.Element.JoinGeometry.dyf (Dynamo 2.1.0.7500)
# category: Synthesize.Packages.Clockwork.Revit.Elements.Element.Actions
# Joins two model elements (if possible). Only works inside the project environment.

VARelement1 = Input(VARelement1: var[]..[])
turnIntoList = Custom[CW.TurnIntoList](VARunknownItem=VARelement1)  # Turns an element (or a nested list) into a flat list
VARelement2 = Input(VARelement2: var[]..[])
turnIntoList_2 = Custom[CW.TurnIntoList](VARunknownItem=VARelement2)
python_script = Python(IN[0]=turnIntoList, IN[1]=turnIntoList_2)
# ---------- python_script.python (25 lines) ----------
import clr
clr.AddReference('RevitAPI')
from Autodesk.Revit.DB import *
from System.Collections.Generic import *
clr.AddReference("RevitServices")
import RevitServices
from RevitServices.Persistence import DocumentManager
from RevitServices.Transactions import TransactionManager

doc = DocumentManager.Instance.CurrentDBDocument
items1 = UnwrapElement(IN[0])
items2 = UnwrapElement(IN[1])
i = 0
booleans = list()
TransactionManager.Instance.EnsureInTransaction(doc)
for item1 in items1:
	try:
		JoinGeometryUtils.JoinGeometry(doc,item1,items2[i])
		booleans.append(True)
	except:
		booleans.append(False)
	i += 1
TransactionManager.Instance.TransactionTaskDone()

OUT = booleans
# ----------------------------------------
