# Dynamo custom node CW.Element.Materials.Areas.dyf (Dynamo 2.1.0.7500)
# category: Synthesize.Packages.Clockwork.Revit.Elements.Element.Query
# Retrieves materials areas from given element

VARelement = Input(VARelement: var[]..[])
turnIntoList = Custom[CW.TurnIntoList](VARunknownItem=VARelement)  # Turns an element (or a nested list) into a flat list
VARreturnPaintMaterials = Input(VARreturnPaintMaterials: bool = false)
python_script = Python(IN[0]=turnIntoList, IN[1]=VARreturnPaintMaterials)
# ---------- python_script.python (14 lines) ----------
import clr
clr.AddReference('RevitAPI')
from Autodesk.Revit.DB import *

items = UnwrapElement(IN[0])
paintedmats = IN[1]
elementareas = list()

for item in items:
	arealist = list()
	for matid in item.GetMaterialIds(paintedmats):
		arealist.append(item.GetMaterialArea(matid,paintedmats))
	elementareas.append(arealist)
OUT = elementareas
# ----------------------------------------
unit_types = UnitTypes("Area")  # graph input
displayUnitType = Custom[CW.UnitType.DisplayUnitType](VARunitType=unit_types)  # Retrieves the display unit type for a given unit type.
toDisplayUnit = Custom[CW.InternalUnit.ToDisplayUnit](VARval=python_script, VARdisplayUnitType=displayUnitType.VARdisplayUnitType)  # Converts a value from Revit's internal unit to a given display unit
returnListOrSingleValue = Custom[CW.ReturnListOrSingleValue](VARunknownItem=VARelement, VARseq=toDisplayUnit)  # If the unknown item is not a list but rather a single item, only the first item of the list (input "seq") will be returned.
VARmaterialVolumes = Output(returnListOrSingleValue)
