# Dynamo custom node CW.Element.Materials.Volumes.dyf (Dynamo 2.1.0.7500)
# category: Synthesize.Packages.Clockwork.Revit.Elements.Element.Query
# Retrieves materials volumes from given element

VARelement = Input(VARelement: var[]..[])
turnIntoList = Custom[CW.TurnIntoList](VARunknownItem=VARelement)  # Turns an element (or a nested list) into a flat list
VARreturnPaintMaterials = Input(VARreturnPaintMaterials: bool = false)
python_script = Python(IN[0]=turnIntoList, IN[1]=VARreturnPaintMaterials)
# ---------- python_script.python (13 lines) ----------
import clr
clr.AddReference('RevitAPI')
from Autodesk.Revit.DB import *

items = UnwrapElement(IN[0])
paintedmats = IN[1]
elementvols = list()
for item in items:
	vollist = list()
	for matid in item.GetMaterialIds(paintedmats):
		vollist.append(item.GetMaterialVolume(matid))
	elementvols.append(vollist)
OUT = (elementvols)
# ----------------------------------------
unit_types = UnitTypes("Volume")  # graph input
displayUnitType = Custom[CW.UnitType.DisplayUnitType](VARunitType=unit_types)  # Retrieves the display unit type for a given unit type.
toDisplayUnit = Custom[CW.InternalUnit.ToDisplayUnit](VARval=python_script, VARdisplayUnitType=displayUnitType.VARdisplayUnitType)  # Converts a value from Revit's internal unit to a given display unit
returnListOrSingleValue = Custom[CW.ReturnListOrSingleValue](VARunknownItem=VARelement, VARseq=toDisplayUnit)  # If the unknown item is not a list but rather a single item, only the first item of the list (input "seq") will be returned.
VARmaterialVolumes = Output(returnListOrSingleValue)
