# Dynamo custom node CW.Element.Materials.dyf (Dynamo 2.1.0.7500)
# category: Synthesize.Packages.Clockwork.Revit.Elements.Element.Query
# Retrieves all materials from a given element

VARelement = Input(VARelement: var[]..[])
turnIntoList = Custom[CW.TurnIntoList](VARunknownItem=VARelement)  # Turns an element (or a nested list) into a flat list
VARreturnPaintMaterials = Input(VARreturnPaintMaterials: bool = false)
python_script = Python(IN[0]=turnIntoList, IN[1]=VARreturnPaintMaterials)
# ---------- python_script.python (22 lines) ----------
import clr
clr.AddReference('RevitAPI')
from Autodesk.Revit.DB import *

items = UnwrapElement(IN[0])
paintedmats = IN[1]
elementmats = list()
elementareas = list()
elementvols = list()

for item in items:
	matlist = list()
	arealist = list()
	vollist = list()
	for matid in item.GetMaterialIds(paintedmats):
		matlist.append(item.Document.GetElement(matid))
		arealist.append(item.GetMaterialArea(matid,paintedmats))
		vollist.append(item.GetMaterialVolume(matid))
	elementmats.append(matlist)
	elementareas.append(arealist)
	elementvols.append(vollist)
OUT = (elementmats,elementareas,elementvols)
# ----------------------------------------
code_block = CodeBlock(seq=python_script) { seq[0]; seq[1]; seq[2]; }
returnListOrSingleValue = Custom[CW.ReturnListOrSingleValue](VARunknownItem=VARelement, VARseq=code_block.out0)  # If the unknown item is not a list but rather a single item, only the first item of the list (input "seq") will be returned.
VARmaterials = Output(returnListOrSingleValue)
unit_types = UnitTypes("Area")  # graph input
displayUnitType = Custom[CW.UnitType.DisplayUnitType](VARunitType=unit_types)  # Retrieves the display unit type for a given unit type.
toDisplayUnit = Custom[CW.InternalUnit.ToDisplayUnit](VARval=code_block.out1, VARdisplayUnitType=displayUnitType.VARdisplayUnitType)  # Converts a value from Revit's internal unit to a given display unit
returnListOrSingleValue_2 = Custom[CW.ReturnListOrSingleValue](VARunknownItem=VARelement, VARseq=toDisplayUnit)
VARmaterialAreas = Output(returnListOrSingleValue_2)
unit_types_2 = UnitTypes("Volume")  # graph input
displayUnitType_2 = Custom[CW.UnitType.DisplayUnitType](VARunitType=unit_types_2)
toDisplayUnit_2 = Custom[CW.InternalUnit.ToDisplayUnit](VARval=code_block.out2, VARdisplayUnitType=displayUnitType_2.VARdisplayUnitType)
returnListOrSingleValue_3 = Custom[CW.ReturnListOrSingleValue](VARunknownItem=VARelement, VARseq=toDisplayUnit_2)
VARmaterialVolumes = Output(returnListOrSingleValue_3)
isEmpty = List.IsEmpty()  # unwired: list
map = List.Map(list=code_block.out0, f_x=isEmpty)
not_ = Not(x=map)
returnListOrSingleValue_4 = Custom[CW.ReturnListOrSingleValue](VARunknownItem=VARelement, VARseq=not_)
VARhasMaterial = Output(returnListOrSingleValue_4)
