# Dynamo custom node CW.Element.OverrideTransparencyInView.dyf (Dynamo 2.1.0.7500)
# category: Synthesize.Packages.Clockwork.Revit.Elements.Element.Actions
# Overrides the transparency of an element in a given view

VARelement = Input(VARelement: var[]..[])
turnIntoList = Custom[CW.TurnIntoList](VARunknownItem=VARelement)  # Turns an element (or a nested list) into a flat list
VARview = Input(VARview: var[]..[])
VARtransparencyPercentage = Input(VARtransparencyPercentage: var[]..[])
python_script = Python(IN[0]=turnIntoList, IN[1]=VARview, IN[2]=VARtransparencyPercentage)
# ---------- python_script.python (27 lines) ----------
import clr
clr.AddReference('RevitAPI')
from Autodesk.Revit.DB import *

clr.AddReference("RevitNodes")
import Revit
clr.ImportExtensions(Revit.Elements)

clr.AddReference("RevitServices")
import RevitServices
from RevitServices.Persistence import DocumentManager
from RevitServices.Transactions import TransactionManager

doc = DocumentManager.Instance.CurrentDBDocument
items = UnwrapElement(IN[0])
view = UnwrapElement(IN[1])
trans = IN[2]
elementlist = list()

override = OverrideGraphicSettings()
override.SetSurfaceTransparency(trans)

TransactionManager.Instance.EnsureInTransaction(doc)
for item in items:
	view.SetElementOverrides(item.Id, override)
TransactionManager.Instance.TransactionTaskDone()
OUT = items
# ----------------------------------------
returnListOrSingleValue = Custom[CW.ReturnListOrSingleValue](VARunknownItem=VARelement, VARseq=python_script)  # If the unknown item is not a list but rather a single item, only the first item of the list (input "seq") will be returned.
VARelement_2 = Output(returnListOrSingleValue)  # "VARelement"
