# Dynamo custom node CW.Element.PermanentlyIsolateInView.dyf (Dynamo 2.1.0.7500)
# category: Synthesize.Packages.Clockwork.Revit.Elements.Element.Actions
# (Permanently) isolates elements in the given view

VARview = Input(VARview: var[]..[])
VARelement = Input(VARelement: var[]..[])
turnIntoList = Custom[CW.TurnIntoList](VARunknownItem=VARelement)  # Turns an element (or a nested list) into a flat list
temporarilyIsolateInView = Custom[CW.Element.TemporarilyIsolateInView](VARview=VARview, VARelement=turnIntoList)  # (Temporarily) isolates elements in the given view
convertTemporaryHideIsolateToPermanent = Custom[CW.View.ConvertTemporaryHideIsolateToPermanent](VARview=temporarilyIsolateInView.VARview)  # Convert all temporary hidden elements or categories to permanently hidden in the given view.
VARview_2 = Output(convertTemporaryHideIsolateToPermanent)  # "VARview"
returnListOrSingleValue = Custom[CW.ReturnListOrSingleValue](VARunknownItem=VARelement, VARseq=temporarilyIsolateInView.VARelement)  # If the unknown item is not a list but rather a single item, only the first item of the list (input "seq") will be returned.
VARelement_2 = Output(returnListOrSingleValue)  # "VARelement"
