# Dynamo custom node CW.Element.TemporarilyIsolateInView.dyf (Dynamo 2.1.0.7500)
# category: Synthesize.Packages.Clockwork.Revit.Elements.Element.Actions
# (Temporarily) isolates elements in the given view

VARelement = Input(VARelement: var[]..[])
turnIntoList = Custom[CW.TurnIntoList](VARunknownItem=VARelement)  # Turns an element (or a nested list) into a flat list
VARview = Input(VARview: var[]..[])
python_script = Python(IN[0]=turnIntoList, IN[1]=VARview)
# ---------- python_script.python (23 lines) ----------
import clr
clr.AddReference('RevitAPI')
from Autodesk.Revit.DB import *
from System.Collections.Generic import *

clr.AddReference("RevitServices")
import RevitServices
from RevitServices.Persistence import DocumentManager
from RevitServices.Transactions import TransactionManager

doc = DocumentManager.Instance.CurrentDBDocument
elements = UnwrapElement(IN[0])
view = UnwrapElement(IN[1])
ids = list()
elementlist = list()
for item in elements:
	ids.append(item.Id)
ielements = List[ElementId](ids)

TransactionManager.Instance.EnsureInTransaction(doc)
view.IsolateElementsTemporary(ielements)
TransactionManager.Instance.TransactionTaskDone()
OUT = (view,elements)
# ----------------------------------------
code_block = CodeBlock(seq=python_script) { seq[0]; seq[1]; }
VARview_2 = Output(code_block.out0)  # "VARview"
returnListOrSingleValue = Custom[CW.ReturnListOrSingleValue](VARunknownItem=VARelement, VARseq=code_block.out1)  # If the unknown item is not a list but rather a single item, only the first item of the list (input "seq") will be returned.
VARelement_2 = Output(returnListOrSingleValue)  # "VARelement"
