# Dynamo custom node CW.FamilyDocument.FamilyParameters.dyf (Dynamo 2.1.0.7500)
# category: Synthesize.Packages.Clockwork.Revit.FamilyDocument.Query
# Retrieves all family parameters from the active family document. PLEASE NOTE: This node will only work in a family document!

VARtoggle = Input(VARtoggle: bool = true)
python_script = Python(IN[0]=VARtoggle)
# ---------- python_script.python (13 lines) ----------
import clr
clr.AddReference('RevitAPI')
from Autodesk.Revit.DB import *

clr.AddReference("RevitServices")
import RevitServices
from RevitServices.Persistence import DocumentManager

doc = DocumentManager.Instance.CurrentDBDocument
elementlist = list()
for param in doc.FamilyManager.Parameters:
	elementlist.append(param)
OUT = elementlist
# ----------------------------------------
VARfamilyParameters = Output(python_script)
