# Dynamo custom node CW.FamilyInstance.RemoveCoping.dyf (Dynamo 2.1.0.7500)
# category: Synthesize.Packages.Clockwork.Revit.Elements.FamilyInstance.Actions
# Removes a coping (cut) from a steel beam

VARfamilyInstance = Input(VARfamilyInstance: var[]..[])
turnIntoList = Custom[CW.TurnIntoList](VARunknownItem=VARfamilyInstance)  # Turns an element (or a nested list) into a flat list
VARcuttingElementToBeRemoved = Input(VARcuttingElementToBeRemoved: var[]..[])
turnIntoList_2 = Custom[CW.TurnIntoList](VARunknownItem=VARcuttingElementToBeRemoved)
python_script = Python(IN[0]=turnIntoList, IN[1]=turnIntoList_2)
# ---------- python_script.python (26 lines) ----------
import clr
import System
clr.AddReference('RevitAPI')
from Autodesk.Revit.DB import *

clr.AddReference("RevitServices")
import RevitServices
from RevitServices.Persistence import DocumentManager
from RevitServices.Transactions import TransactionManager

doc = DocumentManager.Instance.CurrentDBDocument
fams = UnwrapElement(IN[0])
cutters = UnwrapElement(IN[1])
booleans = list()
counter = 0

TransactionManager.Instance.EnsureInTransaction(doc)
for fam in fams:
	try:
		fam.RemoveCoping(cutters[counter])
		booleans.append(True)
	except:	booleans.append(False)
	counter += 1
TransactionManager.Instance.TransactionTaskDone()

OUT = booleans
# ----------------------------------------
returnListOrSingleValue = Custom[CW.ReturnListOrSingleValue](VARunknownItem=VARfamilyInstance, VARseq=python_script)  # If the unknown item is not a list but rather a single item, only the first item of the list (input "seq") will be returned.
VARsuccess = Output(returnListOrSingleValue)
