# Dynamo custom node CW.FamilyType.CompoundStructureHasVariableLayer.dyf (Dynamo 2.1.0.7500)
# category: Synthesize.Packages.Clockwork.Revit.Elements.FamilyType.Query
# Checks if the compound structure of a given floor or roof type contains a variable layer.

VARfamilyType = Input(VARfamilyType: var[]..[])
python_script = Python(IN[0]=VARfamilyType)
# ---------- python_script.python (17 lines) ----------
import clr
clr.AddReference('RevitAPI')
from Autodesk.Revit.DB import *

def HasVariableLayer(item):
	if hasattr(item, "GetCompoundStructure"):
		compstruc = item.GetCompoundStructure()
		if hasattr(compstruc, "VariableLayerIndex"):
			if compstruc.VariableLayerIndex == -1: return False
			else: return True
		else: return False
	else: return False

items = UnwrapElement(IN[0])

if isinstance(IN[0], list): OUT = [HasVariableLayer(x) for x in items]
else: OUT = HasVariableLayer(items)
# ----------------------------------------
VARbool = Output(python_script)
