# Dynamo custom node CW.FamilyType.CompoundStructureLayers.dyf (Dynamo 2.1.0.7500)
# category: Synthesize.Packages.Clockwork.Revit.Elements.FamilyType.Query
# Retrieves the compound layers of any layered family type (wall types, roof types, floor types etc.)

VARelementType = Input(VARelementType: var[]..[])
python_script = Python(IN[0]=VARelementType)
# ---------- python_script.python (43 lines) ----------
import clr
clr.AddReference('RevitAPI')
from Autodesk.Revit.DB import *

clr.AddReference("RevitNodes")
import Revit
clr.ImportExtensions(Revit.Elements)

items = UnwrapElement(IN[0])

def GetCompoundStructureLayers(item):
	layers = []
	layermat = []
	layerfunc = []
	layerwidth = []
	layercore = []
	layerwraps = []
	layervar = []
	layerdeck = []	
	try:
		if hasattr(item, "GetCompoundStructure"):
			compstruc = item.GetCompoundStructure()
			vertcomp = compstruc.IsVerticallyCompound
			varlayer = compstruc.VariableLayerIndex
			num = compstruc.LayerCount
			counter = 0
			while counter < num:
				layers.append(compstruc.GetLayers()[counter])
				layermat.append(item.Document.GetElement(compstruc.GetMaterialId(counter)))
				layerfunc.append(compstruc.GetLayerFunction(counter))
				layerwidth.append(compstruc.GetLayerWidth(counter))
				layercore.append(compstruc.IsCoreLayer(counter))
				if compstruc.IsCoreLayer(counter): layerwraps.append(False)
				else: layerwraps.append(compstruc.ParticipatesInWrapping(counter))
				if varlayer == counter: layervar.append(True)
				else: layervar.append(False)
				layerdeck.append(compstruc.IsStructuralDeck(counter))
				counter += 1
	except: pass
	return layers, layermat, layerfunc, layerwidth, layercore, layerwraps, layervar, layerdeck

if isinstance(IN[0], list): OUT = map(list, zip(*[GetCompoundStructureLayers(x) for x in items]))
else: OUT = GetCompoundStructureLayers(items)
# ----------------------------------------
code_block = CodeBlock(seq=python_script)
# ---------- code_block.designscript (16 lines) ----------
// Layers
seq[0];
// Materials
seq[1];
// Functions
seq[2];
// Widths
seq[3];
// Is core layer
seq[4];
// Wraps
seq[5];
// Is variable
seq[6];
// Is structural deck
seq[7];
# ----------------------------------------
VARmaterials = Output(code_block.out1)
VARfunctions = Output(code_block.out2)
unit_types = UnitTypes("Length")  # graph input
displayUnitType = Custom[CW.UnitType.DisplayUnitType](VARunitType=unit_types)  # Retrieves the display unit type for a given unit type.
toDisplayUnit = Custom[CW.InternalUnit.ToDisplayUnit](VARval=code_block.out3, VARdisplayUnitType=displayUnitType.VARdisplayUnitType)  # Converts a value from Revit's internal unit to a given display unit
VARwidths = Output(toDisplayUnit)
VARisCore = Output(code_block.out4)
VARwraps = Output(code_block.out5)
VARisVariable = Output(code_block.out6)
VARisStructuralDeck = Output(code_block.out7)
VARlayers = Output(code_block.out0)
