# Dynamo custom node CW.FamilyType.SetCompoundLayerWidth.dyf (Dynamo 2.1.0.7500)
# category: Synthesize.Packages.Clockwork.Revit.Elements.FamilyType.Actions
# Sets the width of a specified compound layer of a given family type (only applies to family types that have a compound structure, e.g. walls, floors etc.).

VARfamilyType = Input(VARfamilyType: var[]..[])
turnIntoList = Custom[CW.TurnIntoList](VARunknownItem=VARfamilyType)  # Turns an element (or a nested list) into a flat list
VARlayerIndex = Input(VARlayerIndex: int)
turnIntoList_2 = Custom[CW.TurnIntoList](VARunknownItem=VARlayerIndex)
VARwidth = Input(VARwidth: double)
turnIntoList_3 = Custom[CW.TurnIntoList](VARunknownItem=VARwidth)
code_block = CodeBlock(famtype=turnIntoList, layerindex=turnIntoList_2, width=turnIntoList_3) { [famtype,layerindex,width]; }
equalSublistLengths = Custom[CW.List.EqualSublistLengths](VARlists=code_block)  # Trims all given lists to the length of the shortest list
code_block_2 = CodeBlock(seq=equalSublistLengths) { seq[0]; seq[1]; seq[2]; }
unit_types = UnitTypes("Length")  # graph input
displayUnitType = Custom[CW.UnitType.DisplayUnitType](VARunitType=unit_types)  # Retrieves the display unit type for a given unit type.
toInternalUnit = Custom[CW.DisplayUnit.ToInternalUnit](VARval=code_block_2.out2, VARdisplayUnitType=displayUnitType.VARdisplayUnitType)  # Converts a value from a given display unit to Revit's internal unit
python_script = Python(IN[0]=code_block_2.out0, IN[1]=code_block_2.out1, IN[2]=toInternalUnit)
# ---------- python_script.python (29 lines) ----------
import clr
clr.AddReference('RevitAPI')
from Autodesk.Revit.DB import *

clr.AddReference("RevitServices")
import RevitServices
from RevitServices.Persistence import DocumentManager
from RevitServices.Transactions import TransactionManager

doc = DocumentManager.Instance.CurrentDBDocument
famtypes = UnwrapElement(IN[0])
indices = IN[1]
widths = IN[2]
booleans = list()
counter = 0

TransactionManager.Instance.EnsureInTransaction(doc)
for ft in famtypes:
	try:
		cs = ft.GetCompoundStructure()
		cs.SetLayerWidth(indices[counter],widths[counter])
		ft.SetCompoundStructure(cs)
		booleans.append(True)
	except:
		booleans.append(False)
	counter += 1	
TransactionManager.Instance.TransactionTaskDone()

OUT = (famtypes,booleans)
# ----------------------------------------
code_block_3 = CodeBlock(seq=python_script) { seq[0]; seq[1]; }
returnListOrSingleValue = Custom[CW.ReturnListOrSingleValue](VARunknownItem=VARfamilyType, VARseq=code_block_3.out0)  # If the unknown item is not a list but rather a single item, only the first item of the list (input "seq") will be returned.
VARfamilyType_2 = Output(returnListOrSingleValue)  # "VARfamilyType"
returnListOrSingleValue_2 = Custom[CW.ReturnListOrSingleValue](VARunknownItem=VARfamilyType, VARseq=code_block_3.out1)
VARsuccess = Output(returnListOrSingleValue_2)
