# Dynamo custom node CW.Floor.SlabShapeByPoints.dyf (Dynamo 2.1.0.7500)
# category: Synthesize.Packages.Clockwork.Revit.Elements.Floor.Actions
# Transform a slab shape based on a list of XYZs. PLEASE NOTE: Will reset any previous edits on the slab shape.

VARpoints = Input(VARpoints: Autodesk.DesignScript.Geometry.Point[])
VARfloor = Input(VARfloor: var[]..[])
slabShapeByPoints = Custom[CW.Roof.SlabShapeByPoints](VARpoints=VARpoints, VARroof=VARfloor)  # Transform a slab shape based on a list of XYZs. PLEASE NOTE: Will reset any previous edits on the slab shape.
VARfloor_2 = Output(slabShapeByPoints)  # "VARfloor"
