# Dynamo custom node CW.InternalUnit.ToDisplayUnit.dyf (Dynamo 2.1.0.7500)
# category: Synthesize.Packages.Clockwork.Revit.Units.Actions
# Converts a value from Revit's internal unit to a given display unit

VARval = Input(VARval: double)
turnIntoList = Custom[CW.TurnIntoList](VARunknownItem=VARval)  # Turns an element (or a nested list) into a flat list
VARdisplayUnitType = Input(VARdisplayUnitType: var[]..[])
python_script = Python(IN[0]=turnIntoList, IN[1]=VARdisplayUnitType)
# ---------- python_script.python (10 lines) ----------
import clr
clr.AddReference('RevitAPI')
from Autodesk.Revit.DB import *

vals = IN[0]
dispunit = IN[1]
elementlist = []
for val in vals:
	elementlist.append(UnitUtils.ConvertFromInternalUnits(val,dispunit))
OUT = elementlist
# ----------------------------------------
returnListOrSingleValue = Custom[CW.ReturnListOrSingleValue](VARunknownItem=VARval, VARseq=python_script)  # If the unknown item is not a list but rather a single item, only the first item of the list (input "seq") will be returned.
VARval_2 = Output(returnListOrSingleValue)  # "VARval"
