# Dynamo custom node CW.List.AnyFalse.dyf (Dynamo 2.1.0.7500)
# category: Synthesize.Packages.Clockwork.Core.List.Query
# Returns true if any item in a list of booleans is false.

VARseq = Input(VARseq: bool[])
code_block = CodeBlock(seq=VARseq) { !(AllTrue(seq)); }
VARbool = Output(code_block)
