# Dynamo custom node CW.List.AnyTrue.dyf (Dynamo 2.1.0.7500)
# category: Synthesize.Packages.Clockwork.Core.List.Query
# Returns true if any item in a list of booleans is true.

VARseq = Input(VARseq: bool[])
code_block = CodeBlock(seq=VARseq) { !(AllFalse(seq)); }
VARbool = Output(code_block)
