# Dynamo custom node CW.List.DropLastItem.dyf (Dynamo 2.1.0.7500)
# category: Synthesize.Packages.Clockwork.Core.List.Actions
# Drops the last item from a given list.

VARlist = Input(VARlist: var[])
code_block = CodeBlock(l1=VARlist) { List.DropItems(l1,-1); }
VARlist_2 = Output(code_block)  # "VARlist"
