# Dynamo custom node CW.List.EqualSublistLengths.dyf (Dynamo 2.1.0.7500)
# category: Synthesize.Packages.Clockwork.Core.List.Actions
# Trims all given lists to the length of the shortest list

VARlists = Input(VARlists: var[]..[])
sublistLengths = Custom[CW.List.SublistLengths](VARseq=VARlists)  # Gets the lengths of all sublists in a given list of lists.
code_block = CodeBlock(seq=sublistLengths) { List.MinimumItem(seq); }
takeItems = List.TakeItems(amount=code_block)  # unwired: list
map = List.Map(list=VARlists, f_x=takeItems)
VARlists_2 = Output(map)  # "VARlists"
