# Dynamo custom node CW.List.GroupListOfListsByKey.dyf (Dynamo 2.1.0.7500)
# category: Synthesize.Packages.Clockwork.Core.List.Actions
# Groups a list of lists by one of its keys

VARseq = Input(VARseq: var[]..[])
VARkeyIndex = Input(VARkeyIndex: int = 0)
boolean = BoolSelector(false)  # graph input
sortListOfLists = Custom[CW.List.SortListOfLists](VARseq=VARseq, VARsortIndex=VARkeyIndex, VARcaseInsensitive=boolean, VARorderDescending=boolean)  # Sorts a list of lists by one of its sublists
code_block = CodeBlock(seq=sortListOfLists) { List.Transpose(seq); }
python_script = Python(IN[0]=code_block, IN[1]=VARkeyIndex)
# ---------- python_script.python (13 lines) ----------
import clr
from itertools import groupby

items = IN[0]
groupindex = int(IN[1])
listlist = list()

for key, group in groupby(items, lambda x: x[groupindex]):
	elementlist = list()
	for thing in group:
		elementlist.append(thing)
	listlist.append(elementlist)
OUT = listlist
# ----------------------------------------
transpose = List.Transpose()  # unwired: lists
map = List.Map(list=python_script, f_x=transpose)
VARseq_2 = Output(map)  # "VARseq"
