# Dynamo custom node CW.List.MatchWithKeyValues.dyf (Dynamo 2.1.0.7500)
# category: Synthesize.Packages.Clockwork.Core.List.Actions
# Matches a list with a given set of keys and returns the values corresponding to the keys

VARseq = Input(VARseq: var[]..[])
turnIntoList = Custom[CW.TurnIntoList](VARunknownItem=VARseq)  # Turns an element (or a nested list) into a flat list
VARkeys = Input(VARkeys: var[]..[])
turnIntoList_2 = Custom[CW.TurnIntoList](VARunknownItem=VARkeys)
VARvalues = Input(VARvalues: var[]..[])
turnIntoList_3 = Custom[CW.TurnIntoList](VARunknownItem=VARvalues)
python_script = Python(IN[0]=turnIntoList, IN[1]=turnIntoList_2, IN[2]=turnIntoList_3)
# ---------- python_script.python (17 lines) ----------
import clr

items = IN[0]
keys = IN[1]
values = IN[2]
elementlist = list()
for item in items:
	counter = 0
	hasmatch = False
	for key in keys:
		if (item == key):
			elementlist.append(values[counter])
			hasmatch = True
		counter += 1
	if hasmatch == False:
		elementlist.append(None)
OUT = elementlist
# ----------------------------------------
VARseq_2 = Output(python_script)  # "VARseq"
