# Dynamo custom node CW.List.ReplaceEmptyLists.dyf (Dynamo 2.1.0.7500)
# category: Synthesize.Packages.Clockwork.Core.List.Actions
# Replaces all empty lists within a given list with a substitute

VARseq = Input(VARseq: var[]..[])
isNotEmpty = Custom[CW.List.IsNotEmpty]()  # Just the inversion of the built-in Is Empty List node.; unwired: VARseq
map = List.Map(list=VARseq, f_x=isNotEmpty)
boolean = BoolSelector(true)  # graph input
replaceNull = Custom[CW.List.ReplaceNull](VARseq=map, VARreplacement=boolean)  # Replaces all null values within a given list with a substitute
code_block = CodeBlock(seq=replaceNull, mask=replaceNull) { keys = GetKeys(seq); List.FilterByBoolMask(keys, mask)["out"]; }
VARReplacement = Input(VARReplacement: var[]..[])
replaceItemAtIndex = Custom[CW.List.ReplaceItemAtIndex+](VARseq=VARseq, VARindex=code_block.out1, VARreplacement=VARReplacement)  # Replaces the item at a given index (or list of indices) of a list by another item
VARseq_2 = Output(replaceItemAtIndex)  # "VARseq"
