# Dynamo custom node CW.List.ReplaceItemAtIndex+.dyf (Dynamo 2.1.0.7500)
# category: Synthesize.Packages.Clockwork.Core.List.Actions
# Replaces the item at a given index (or list of indices) of a list by another item

VARseq = Input(VARseq: var[]..[])
VARreplacement = Input(VARreplacement: var[]..[])
turnIntoList = Custom[CW.TurnIntoList](VARunknownItem=VARreplacement)  # Turns an element (or a nested list) into a flat list
VARindex = Input(VARindex: var[]..[])
turnIntoList_2 = Custom[CW.TurnIntoList](VARunknownItem=VARindex)
python_script = Python(IN[0]=VARseq, IN[1]=turnIntoList, IN[2]=turnIntoList_2)
# ---------- python_script.python (8 lines) ----------
_list = IN[0]
rValues = IN[1]
iValues = IN[2]
if len(iValues) > 1 and len(rValues) == 1:
	rValues = [rValues[0]] * len(iValues)
for (index, value) in zip(iValues, rValues):
	_list[index] = value
OUT = _list
# ----------------------------------------
VARseq_2 = Output(python_script)  # "VARseq"
