# Dynamo custom node CW.List.ReplaceNull.dyf (Dynamo 2.1.0.7500)
# category: Synthesize.Packages.Clockwork.Core.List.Actions
# Replaces all null values within a given list with a substitute

VARseq = Input(VARseq: var[]..[])
VARreplacement = Input(VARreplacement: var[]..[])
python_script = Python(IN[0]=VARseq, IN[1]=VARreplacement)
# ---------- python_script.python (8 lines) ----------
items = IN[0]
rep = IN[1]
elementlist = list()
for item in items:
	if item is None: 
		item = rep
	elementlist.append(item)
OUT = elementlist
# ----------------------------------------
VARseq_2 = Output(python_script)  # "VARseq"
