# Dynamo custom node CW.List.SublistLengths.dyf (Dynamo 2.1.0.7500)
# category: Synthesize.Packages.Clockwork.Core.List.Query
# Gets the lengths of all sublists in a given list of lists.

VARseq = Input(VARseq: var[]..[])
count = List.Count()  # unwired: list
map = List.Map(list=VARseq, f_x=count)
VARlengths = Output(map)
