# Dynamo custom node CW.List.WithLeadingZeroes.dyf (Dynamo 2.1.0.7500)
# category: Synthesize.Packages.Clockwork.Core.List.Create
# Adds leading zeros to a sequence of numbers

VARnum = Input(VARnum: int)
string_from_object = FromObject(obj=VARnum)
VARn = Input(VARn: int)
code_block = CodeBlock { "0"; }
padLeft = String.PadLeft(str=string_from_object, newWidth=VARn, padChars=code_block)
VARstr = Output(padLeft)
