# Dynamo custom node CW.Math.IsEvenNumber.dyf (Dynamo 2.1.0.7500)
# category: Synthesize.Packages.Clockwork.Core.Math.Query
# Checks if a number is even.

VARval = Input(VARval: int)
isOddNumber = Custom[CW.Math.IsOddNumber](VARval=VARval)  # Checks if a number is odd.
not_ = Not(x=isOddNumber)
VARbool = Output(not_)
