# Dynamo custom node CW.Math.IsMultipleOf.dyf (Dynamo 2.1.0.7500)
# category: Synthesize.Packages.Clockwork.Core.Math.Query
# Checks if A is a multiple of B.

VARA = Input(VARA: double)
VARB = Input(VARB: double)
code_block = CodeBlock(a=VARA, b=VARB) { !(a%b > 0); }
VARbool = Output(code_block)
