# Dynamo custom node CW.Math.IsOddNumber.dyf (Dynamo 2.1.0.7500)
# category: Synthesize.Packages.Clockwork.Core.Math.Query
# Checks if a number is odd.

VARval = Input(VARval: int)
code_block = CodeBlock(n=VARval) { Math.Round(n)/2 != Math.Round(Math.Round(n)/2); }
VARbool = Output(code_block)
