# Dynamo custom node CW.Math.RoundToPrecision.dyf (Dynamo 2.1.0.7500)
# category: Synthesize.Packages.Clockwork.Core.Math.Actions
# Rounds a number to a specified precision

VARdbl = Input(VARdbl: double)
VARprecision = Input(VARprecision: double = 1)
code_block = CodeBlock(a=VARdbl, b=VARprecision) { Math.Round(a/b)*b; }
VARdbl_2 = Output(code_block)  # "VARdbl"
