# Dynamo custom node CW.Mesh.FaceVertices.dyf (Dynamo 2.1.0.7500)
# category: Synthesize.Packages.Clockwork.Geometry.Mesh.Query
# Gets the vertices of each face of a given mesh

VARmesh = Input(VARmesh: Autodesk.DesignScript.Geometry.Mesh)
code_block = CodeBlock(m=VARmesh)
# ---------- code_block.designscript (6 lines) ----------
vp = m.VertexPositions;
fi = m.FaceIndices;
a = List.GetItemAtIndex(vp,fi.A);
b = List.GetItemAtIndex(vp,fi.B);
c = List.GetItemAtIndex(vp,fi.C);
List.Transpose([a,b,c]);
# ----------------------------------------
VARvertices = Output(code_block.out5)
