# Dynamo custom node CW.ModelCurve.Type.dyf (Dynamo 2.1.0.7500)
# category: Synthesize.Packages.Clockwork.Revit.Elements.ModelCurve.Query
# Gets the type of a given model curve

VARmodelCurve = Input(VARmodelCurve: var[]..[])
python_script = Python(IN[0]=VARmodelCurve)
# ---------- python_script.python (12 lines) ----------
import clr
clr.AddReference('RevitAPI')
from Autodesk.Revit.DB import *

def GetCurveType(item):
	if hasattr(item, "CurveElementType"): return item.CurveElementType
	else: return None

items = UnwrapElement(IN[0])

if isinstance(IN[0], list): OUT = [GetCurveType(x) for x in items]
else: OUT = GetCurveType(items)
# ----------------------------------------
VARtype = Output(python_script)
