# Dynamo custom node CW.Normal.CorrectOrientation.dyf (Dynamo 2.1.0.7500)
# category: Synthesize.Packages.Clockwork.Geometry.Vector.Actions
# Inverts normal A if its inversion is closer to normal B

VARVectorA = Input(VARVectorA: Autodesk.DesignScript.Geometry.Vector)
VARVectorB = Input(VARVectorB: Autodesk.DesignScript.Geometry.Vector)
code_block = CodeBlock(a=VARVectorA, b=VARVectorB)
# ---------- code_block.designscript (5 lines) ----------
VecA=a.Normalized();
cond = VecA.Dot(b.Normalized()) > 0;
// If the dot product of the vectors is greater than 0,
// they are pointing in the same general direction.
cond ? VecA : VecA.Scale(-1);
# ----------------------------------------
VARVector = Output(code_block.out2)
