# Dynamo custom node CW.Paneling.BuildTriangularSublists.dyf (Dynamo 2.1.0.7500)
# category: Synthesize.Packages.Clockwork.Paneling.Helpers
# Creates sublists of three items each from a list based on given indices, shift and reverse settings and offset.

VARseq = Input(VARseq: var[]..[])
VARindex0 = Input(VARindex0: int)
VARindex1 = Input(VARindex1: int)
VARindex2 = Input(VARindex2: int)
code_block = CodeBlock(a=VARindex0, b=VARindex1, c=VARindex2)
# ---------- code_block.designscript (2 lines) ----------
// Create default placement patterns (counter-clockwise)
[a,b,c];
# ----------------------------------------
VARshift = Input(VARshift: int = 0)
VARreverse = Input(VARreverse: bool = false)
shiftPlacementAndReverse = Custom[CW.Paneling.ShiftPlacementAndReverse](VARseq=code_block, VARshift=VARshift, VARreverse=VARreverse)  # Shifts (integer) and reverses (bool) a given list
VARoffset = Input(VARoffset: int)
code_block_2 = CodeBlock(seq=VARseq, pat=shiftPlacementAndReverse, offset=VARoffset)
# ---------- code_block_2.designscript (2 lines) ----------
// Create sublists using placement pattern
List.Sublists(seq,[pat[0],pat[1],pat[2]],offset);
# ----------------------------------------
VARseq_2 = Output(code_block_2)  # "VARseq"
