# Dynamo custom node CW.Paneling.DropLastRowAndColumn.dyf (Dynamo 2.1.0.7500)
# category: Synthesize.Packages.Clockwork.Paneling.Helpers
# Drops the last row and column from a UV field

VARseq = Input(VARseq: var[]..[])
VARV = Input(VARV: int)
code_block = CodeBlock(seq1=VARseq, V=VARV)
# ---------- code_block.designscript (5 lines) ----------
amount = Count(seq1)-V;
// Drop the last row
seq2 = List.TakeItems(seq1,amount);
// Drop the last column
List.DropEveryNthItem(seq2,V,0);
# ----------------------------------------
VARseq_2 = Output(code_block.out2)  # "VARseq"
