# Dynamo custom node CW.Paneling.GridFromFace.dyf (Dynamo 2.1.0.7500)
# category: Synthesize.Packages.Clockwork.Paneling.DataPreparation
# Returns UV coordinates, XYZ coordinates and normals for a face with UV subdivision

VARU = Input(VARU: int)
VARV = Input(VARV: int)
VARsurface = Input(VARsurface: Autodesk.DesignScript.Geometry.Surface)
code_block = CodeBlock(unum=VARU, vnum=VARV, surf=VARsurface)
# ---------- code_block.designscript (4 lines) ----------
uvlist = UV.ByCoordinates((0..1..#unum+1)<1>,(0..1..#vnum+1)<2>);
UVs = DSCore.List.Flatten(uvlist);
surf.PointAtParameter(UVs.U,UVs.V);
surf.NormalAtParameter(UVs.U,UVs.V);
# ----------------------------------------
VARPoints = Output(code_block.out2)
VARNormals = Output(code_block.out3)
VARUVs = Output(code_block.UVs)
