# Dynamo custom node CW.Paneling.Hexagonal.dyf (Dynamo 2.1.0.7500)
# category: Synthesize.Packages.Clockwork.Paneling.Patterns
# Creates groups of points from a list of UVs or XYZs for the placement of hexagonal panels. The placement pattern can be reversed (boolean) and shifted (integer).

VARrotateGridBy90Degrees = Input(VARrotateGridBy90Degrees: bool = false)
VVAR = Input(VVAR: int)
VARseq = Input(VARseq: var[]..[])
code_block = CodeBlock(rotate_grid=VARrotateGridBy90Degrees, v=VVAR, seq=VARseq)
# ---------- code_block.designscript (18 lines) ----------
// Sublist lengths rows
sublength = rotate_grid ? (v+1)*3 : (v+1)*4;
oddrows[0] = List.Sublists(seq,0..sublength-1,(v+1)*2);
oddrows[1] = List.Chop(seq,sublength);
oddrows[rotate_grid ? 0 : 1];
// Remove elements for even rows
drop_even = rotate_grid ? (v+1)*1 : (v+1)*2;
evenrows[0] = List.Sublists(List.DropItems(seq,drop_even),0..sublength-1,(v+1)*2);
evenrows[1] = List.Chop(List.DropItems(seq,drop_even),sublength);
evenrows[rotate_grid ? 0 : 1];
// Default placement pattern (counter-clockwise)
pat_odd = rotate_grid ? [1,2,v+4,2*(v+1)+2,2*(v+1)+1,v+1] : [1,v+3,2*(v+1)+2,3*(v+1)+1,2*(v+1),v+1];
pat_even = pat_odd + (rotate_grid ? 2 : 1);
// Determine panel offset
offset = rotate_grid ? 4 : 2;
// Prepare check for multiples
v+2;
4;
# ----------------------------------------
VARshiftPlacementOddRows = Input(VARshiftPlacementOddRows: int = 0)
VARreverseOddRows = Input(VARreverseOddRows: bool = false)
shiftPlacementAndReverse = Custom[CW.Paneling.ShiftPlacementAndReverse](VARseq=code_block.pat_odd, VARshift=VARshiftPlacementOddRows, VARreverse=VARreverseOddRows)  # Shifts (integer) and reverses (bool) a given list
sublists = List.Sublists(ranges=shiftPlacementAndReverse, offset=code_block.offset)  # unwired: list
map = List.Map(list=code_block.out3, f_x=sublists)
code_block_2 = CodeBlock { 1; 6; }
flatten = List.Flatten(list=map, amt=code_block_2.out0)
filterBySublistLength = Custom[CW.List.FilterBySublistLength](VARseq=flatten, VARlength=code_block_2.out1)  # Filters out all sublists that do not have the specified length
isMultipleOf = Custom[CW.Math.IsMultipleOf](VARA=code_block.out11, VARB=code_block.out12)  # Checks if A is a multiple of B.
isEvenNumber = Custom[CW.Math.IsEvenNumber](VARval=VVAR)  # Checks if a number is even.
VARshiftPlacementEvenRows = Input(VARshiftPlacementEvenRows: int = 0)
VARreverseEvenRows = Input(VARreverseEvenRows: bool = false)
shiftPlacementAndReverse_2 = Custom[CW.Paneling.ShiftPlacementAndReverse](VARseq=code_block.pat_even, VARshift=VARshiftPlacementEvenRows, VARreverse=VARreverseEvenRows)
sublists_2 = List.Sublists(ranges=shiftPlacementAndReverse_2, offset=code_block.offset)  # unwired: list
map_2 = List.Map(list=code_block.out7, f_x=sublists_2)
flatten_2 = List.Flatten(list=map_2, amt=code_block_2.out0)
filterBySublistLength_2 = Custom[CW.List.FilterBySublistLength](VARseq=flatten_2, VARlength=code_block_2.out1)
isMultipleOf_2 = Custom[CW.Math.IsMultipleOf](VARA=VVAR, VARB=code_block.out12)
code_block_3 = CodeBlock(seq1=filterBySublistLength.VARin, v=VVAR, ismultipleof4plus2=isMultipleOf, rotate_grid=VARrotateGridBy90Degrees, iseven=isEvenNumber, seq2=filterBySublistLength_2.VARin, ismultipleof4=isMultipleOf_2)
# ---------- code_block_3.designscript (17 lines) ----------
// Get rid of excess panel coordinates
// Odd rows
num_rows1 = List.Count(seq1)/(v+2)*4;
seq1a[0] = List.DropEveryNthItem(seq1,List.Count(seq1)/num_rows1);
seq1a[1] = seq1;
index1a = (ismultipleof4plus2 && rotate_grid == true) ? 0 : 1;
seq1b[0] = List.DropEveryNthItem(seq1a[index1a],(v+1)/2);
seq1b[1] = seq1a[index1a];
seq1b[(!iseven && rotate_grid == false) ? 0 : 1];
// Even rows
num_rows2 = List.Count(seq2)/v*4;
seq2a[0] = List.DropEveryNthItem(seq2,List.Count(seq2)/num_rows2);
seq2a[1] = seq2;
index2a = (ismultipleof4 && rotate_grid == true) ? 0 : 1;
seq2b[0] = List.DropEveryNthItem(seq2a[index2a],v/2);
seq2b[1] = seq2a[index2a];
seq2b[(iseven && rotate_grid == false) ? 0 : 1];
# ----------------------------------------
VARoddRows = Output(code_block_3.out6)
VARevenRows = Output(code_block_3.out13)
