# Dynamo custom node CW.Paneling.TriangularFlatDiagonal.dyf (Dynamo 2.1.0.7500)
# category: Synthesize.Packages.Clockwork.Paneling.Patterns
# Creates groups of points from a list of UVs or XYZs for the placement of triangular panels. The placement pattern can be reversed (boolean) and shifted (integer).

VARV = Input(VARV: int)
VARshiftOverallPlacement = Input(VARshiftOverallPlacement: int = 0)
VARrotateGridBy90Degrees = Input(VARrotateGridBy90Degrees: bool = false)
VARseq = Input(VARseq: var[]..[])
swap = Custom[CW.UV.Swap](VARuv=VARseq)  # Swaps U and V coordinates
code_block = CodeBlock(V=VARV, shift=VARshiftOverallPlacement, rotate=VARrotateGridBy90Degrees, seq_swapped=swap, seq=VARseq)
# ---------- code_block.designscript (10 lines) ----------
// Create placement pattern
pat1 = [0,V+1,V+2,1];
// Shift overall placement pattern
pat2 = List.ShiftIndices(pat1,shift);
pat2[0];
pat2[1];
pat2[2];
pat2[3];
// Rotate coordinates (if applicable)
rotate ? seq_swapped : seq;
# ----------------------------------------
n1 = Custom[CW.+1](VARdbl=VARV)  # Increments a value by 1
VARreverseTypeA = Input(VARreverseTypeA: bool = false)
VARshiftPlacementTypeA = Input(VARshiftPlacementTypeA: int = 0)
triangularSubpattern = Custom[CW.Paneling.TriangularSubpattern](VARseq=code_block.out6, VARV=n1, VARreversePattern=VARreverseTypeA, VARshiftPattern=VARshiftPlacementTypeA, VARpoint1=code_block.out4, VARpoint2=code_block.out5, VARpoint3=code_block.out2)  # Subcomponent of the Triangular Pattern From Grid node.
VARtypeA = Output(triangularSubpattern)
VARreverseTypeB = Input(VARreverseTypeB: bool = false)
VARshiftPlacementTypeB = Input(VARshiftPlacementTypeB: int = 0)
triangularSubpattern_2 = Custom[CW.Paneling.TriangularSubpattern](VARseq=code_block.out6, VARV=n1, VARreversePattern=VARreverseTypeB, VARshiftPattern=VARshiftPlacementTypeB, VARpoint1=code_block.out2, VARpoint2=code_block.out3, VARpoint3=code_block.out4)
VARtypeB = Output(triangularSubpattern_2)
