# Dynamo custom node CW.Paneling.TriangularSubpattern.dyf (Dynamo 2.1.0.7500)
# category: Synthesize.Packages.Clockwork.Paneling.Helpers
# Subcomponent of the Triangular Pattern From Grid node.

VARseq = Input(VARseq: var[]..[])
code_block = CodeBlock { 1; }
VARshiftPattern = Input(VARshiftPattern: int = 0)
VARreversePattern = Input(VARreversePattern: bool = false)
VARpoint1 = Input(VARpoint1: int)
VARpoint2 = Input(VARpoint2: int)
VARpoint3 = Input(VARpoint3: int)
buildTriangularSublists = Custom[CW.Paneling.BuildTriangularSublists](VARseq=VARseq, VARoffset=code_block, VARshift=VARshiftPattern, VARreverse=VARreversePattern, VARindex0=VARpoint1, VARindex1=VARpoint2, VARindex2=VARpoint3)  # Creates sublists of three items each from a list based on given indices, shift and reverse settings and offset.
VARV = Input(VARV: int)
# note: Unclutter
dropLastRowAndColumn = Custom[CW.Paneling.DropLastRowAndColumn](VARseq=buildTriangularSublists, VARV=VARV)  # Drops the last row and column from a UV field
VARseq_2 = Output(dropLastRowAndColumn)  # "VARseq"
