# Dynamo custom node CW.Passthrough.dyf (Dynamo 2.1.0.7500)
# category: Synthesize.Packages.Clockwork.Core.Sequence.Query
# Forces a sequential order of execution. The node wired into the output of the Passthrough node will be executed *after* the node wired into the waitFor input (e.g. important for some Revit operations). The value of the passThrough input will be passed on to the node wired into the output port of the Passthrough node.

VARpassThrough = Input(VARpassThrough: var[]..[])
VARwaitFor = Input(VARwaitFor: var[]..[])
code_block = CodeBlock(passthrough=VARpassThrough, waitfor=VARwaitFor) { [passthrough,waitfor][0]; }
VARpassThrough_2 = Output(code_block)  # "VARpassThrough"
