# Dynamo custom node CW.PerspectiveView.OrientToEyeAndTargetPosition.dyf (Dynamo 2.1.0.7500)
# category: Synthesize.Packages.Clockwork.Revit.Views.PerspectiveView.Actions
# Sets the orientation of a given perspective view based on a given eye and target position

VARview = Input(VARview: Revit.Elements.Views.PerspectiveView)
isLocked = Custom[CW.View3D.IsLocked](VARview3d=VARview)  # Checks if a given view is locked
VAReyePosition = Input(VAReyePosition: Autodesk.DesignScript.Geometry.Point)
VARtargetPosition = Input(VARtargetPosition: Autodesk.DesignScript.Geometry.Point)
code_block = CodeBlock(epos=VAReyePosition, tpos=VARtargetPosition)
# ---------- code_block.designscript (5 lines) ----------
v1 = Vector.ByTwoPoints(epos,tpos).Normalized();
zvec = Vector.ZAxis();
p3 = tpos.Add(zvec);
n = Plane.ByThreePoints(epos,tpos,p3).Normal;
v1.Rotate(n,90);
# ----------------------------------------
correctOrientation = Custom[CW.Normal.CorrectOrientation](VARVectorA=code_block.out4, VARVectorB=code_block.zvec)  # Inverts normal A if its inversion is closer to normal B
python_script = Python(IN[0]=VARview, IN[1]=VAReyePosition, IN[2]=correctOrientation, IN[3]=code_block.v1)
# ---------- python_script.python (27 lines) ----------
import clr
clr.AddReference('RevitAPI')
from Autodesk.Revit.DB import *

clr.AddReference("RevitNodes")
import Revit
clr.ImportExtensions(Revit.Elements)
clr.ImportExtensions(Revit.GeometryConversion)

clr.AddReference("RevitServices")
import RevitServices
from RevitServices.Persistence import DocumentManager
from RevitServices.Transactions import TransactionManager

doc = DocumentManager.Instance.CurrentDBDocument
view = UnwrapElement(IN[0])
eyeposition = IN[1].ToXyz()
updirection = IN[2].ToXyz()
forwarddirection = IN[3].ToXyz()

TransactionManager.Instance.EnsureInTransaction(doc)
newVO = ViewOrientation3D(eyeposition, updirection, forwarddirection)
view.SetOrientation(newVO)
view.SaveOrientation()
TransactionManager.Instance.TransactionTaskDone()

OUT = view
# ----------------------------------------
code_block_2 = CodeBlock(islocked=isLocked, view=python_script) { islocked ? "The view is locked..." : view; }
VARView = Output(code_block_2)
