# Dynamo custom node CW.Plane.ByBestFitFromFace.dyf (Dynamo 2.1.0.7500)
# category: Synthesize.Packages.Clockwork.Geometry.Plane.Create
# Creates a plane from face

VARsurface = Input(VARsurface: Autodesk.DesignScript.Geometry.Surface)
code_block = CodeBlock(surf=VARsurface) { Plane.ByBestFitThroughPoints(surf.Vertices.PointGeometry); }
VARplane = Output(code_block)
