# Dynamo custom node CW.Point.RoundUpToPrecision.dyf (Dynamo 2.1.0.7500)
# category: Synthesize.Packages.Clockwork.Geometry.Point.Actions
# Rounds a point coordinate *up* to a specified precision

VARpointp = Input(VARpointp: var[]..[])
VARprecision = Input(VARprecision: var[]..[])
code_block = CodeBlock(po=VARpointp, pr=VARprecision) { a = [po.X,po.Y,po.Z]; ar = Math.Ceiling(a/pr)*pr; Autodesk.Point.ByCoordinates(ar[0],ar[1],ar[2]); }
VARpoint = Output(code_block.out2)
