# Dynamo custom node CW.Polygon.ContainmentTest+.dyf (Dynamo 2.1.0.7500)
# category: Synthesize.Packages.Springs.Geometry
# A less accurate method that should perform faster than the built-in node for large data sets.

VARpolygon = Input(VARpolygon: var)
VARpoints = Input(VARpoints: var[])
python_script = Python(IN[0]=VARpolygon, IN[1]=VARpoints)
# ---------- python_script.python (30 lines) ----------
# Copyright(c) 2017, Dimitar Venkov
# @5devene, dimitar.ven@gmail.com
# www.badmonkeys.net

def tolist(obj1):
	if hasattr(obj1,'__iter__'): return obj1
	else: return [obj1]

def containment(poly, pt):
	def is_CCW(A,B,C): return (B.X - A.X) * (C.Y - A.Y) > (B.Y - A.Y) * (C.X - A.X)
	
	wn = 0
	for i in xrange(len(poly)-1):
		if poly[i].Y <= pt.Y:
			if poly[i+1].Y > pt.Y and is_CCW(poly[i], poly[i+1],pt): wn += 1
		else:
			if poly[i+1].Y <=pt.Y and not is_CCW(poly[i], poly[i+1],pt): wn -= 1
	if wn != 0 : return True
	else : return False

poly = IN[0]
pts = tolist(IN[1])

if 'Polygon' in poly.GetType().ToString():
	poly_pts = list(poly.Points)
else:
	poly_pts = [c.StartPoint for c in poly.Curves()]
poly_pts.append(poly_pts[0])

OUT = [containment(poly_pts, p) for p in pts]
# ----------------------------------------
VARbool = Output(python_script)
