# Dynamo custom node CW.ReturnListOrSingleValue.dyf (Dynamo 2.1.0.7500)
# category: Synthesize.Packages.Clockwork.Core.Logic.Actions
# If the unknown item is not a list but rather a single item, only the first item of the list (input "seq") will be returned.

VARunknownItem = Input(VARunknownItem: var[]..[])
VARseq = Input(VARseq: var[]..[])
python_script = Python(IN[0]=VARunknownItem, IN[1]=VARseq)
# ---------- python_script.python (4 lines) ----------
check = IN[0]
items = IN[1]
if isinstance(check, (list)): OUT = items
else: OUT = items[0]
# ----------------------------------------
VAR = Output(python_script)
