# Dynamo custom node CW.RevitFace.FromDynamoSurface.dyf (Dynamo 2.1.0.7500)
# category: Synthesize.Packages.Clockwork.Revit.Selection.Filters
# Returns the underlying Revit face of a given surface

VARDynamoSurface = Input(VARDynamoSurface: Autodesk.DesignScript.Geometry.Surface)
turnIntoList = Custom[CW.TurnIntoList](VARunknownItem=VARDynamoSurface)  # Turns an element (or a nested list) into a flat list
python_script = Python(IN[0]=turnIntoList)
# ---------- python_script.python (19 lines) ----------
import clr
clr.AddReference('RevitAPI')
from Autodesk.Revit.DB import *

clr.AddReference("RevitServices")
import RevitServices
from RevitServices.Persistence import DocumentManager

doc = DocumentManager.Instance.CurrentDBDocument
faces = UnwrapElement(IN[0])
elementlist = list()
for face in faces:
	try:
		ref = face.Tags.LookupTag("RevitFaceReference")
		face = doc.GetElement(ref).GetGeometryObjectFromReference(ref)
		elementlist.append(face)
	except:
		elementlist.append(list())
OUT = elementlist
# ----------------------------------------
returnListOrSingleValue = Custom[CW.ReturnListOrSingleValue](VARunknownItem=VARDynamoSurface, VARseq=python_script)  # If the unknown item is not a list but rather a single item, only the first item of the list (input "seq") will be returned.
VARRevitFace = Output(returnListOrSingleValue)
