# Dynamo custom node CW.RevitFaceReference.FromDynamoSurface.dyf (Dynamo 2.1.0.7500)
# category: Synthesize.Packages.Clockwork.Revit.Selection.ByFace
# Returns the underlying Revit face reference of a given surface

VARDynamoSurface = Input(VARDynamoSurface: Autodesk.DesignScript.Geometry.Surface)
turnIntoList = Custom[CW.TurnIntoList](VARunknownItem=VARDynamoSurface)  # Turns an element (or a nested list) into a flat list
python_script = Python(IN[0]=turnIntoList)
# ---------- python_script.python (13 lines) ----------
import clr
clr.AddReference('RevitAPI')
from Autodesk.Revit.DB import *

faces = UnwrapElement(IN[0])
elementlist = list()
for face in faces:
	try:
		ref = face.Tags.LookupTag("RevitFaceReference")
		elementlist.append(ref)
	except:
		elementlist.append(list())
OUT = elementlist
# ----------------------------------------
returnListOrSingleValue = Custom[CW.ReturnListOrSingleValue](VARunknownItem=VARDynamoSurface, VARseq=python_script)  # If the unknown item is not a list but rather a single item, only the first item of the list (input "seq") will be returned.
VARRevitFaceReference = Output(returnListOrSingleValue)
