# Dynamo custom node CW.Roof.SlabShapeHasBeenModified.dyf (Dynamo 2.1.0.7500)
# category: Synthesize.Packages.Clockwork.Revit.Elements.Roof.Query
# Checks if the shape of a roof slab has been modified with the shape editing tools

VARroof = Input(VARroof: var[]..[])
turnIntoList = Custom[CW.TurnIntoList](VARunknownItem=VARroof)  # Turns an element (or a nested list) into a flat list
python_script = Python(IN[0]=turnIntoList)
# ---------- python_script.python (16 lines) ----------
import clr
clr.AddReference('RevitAPI')
from Autodesk.Revit.DB import *

items = UnwrapElement(IN[0])
elementlist = list()

for item in items:
	try: 
		if item.SlabShapeEditor.SlabShapeCreases.IsEmpty == True or item.SlabShapeEditor.SlabShapeVertices.IsEmpty == True:
			elementlist.append(False)
		else:
			elementlist.append(True)
	except:
		elementlist.append(False)
OUT = elementlist
# ----------------------------------------
returnListOrSingleValue = Custom[CW.ReturnListOrSingleValue](VARunknownItem=VARroof, VARseq=python_script)  # If the unknown item is not a list but rather a single item, only the first item of the list (input "seq") will be returned.
VARbool = Output(returnListOrSingleValue)
