# Dynamo custom node CW.Room.State.dyf (Dynamo 2.1.0.7500)
# category: Synthesize.Packages.Clockwork.Revit.Elements.Room.Query
# Returns the state of a room, i.e. is it placed, unplaced, redundant or not enclosed.

VARroom = Input(VARroom: var[]..[])
location = Room.Location(room=VARroom)
isNull = Object.IsNull(obj=location)
not_ = Not(x=isNull)
area = Room.Area(room=VARroom)
code_block = CodeBlock(area=area) { area > 0; }
boundaries = Custom[CW.Room.Boundaries](VARroom=VARroom)  # Gets a list of all boundary elements of a given room or area
isEmpty = List.IsEmpty(list=boundaries.VARcurves@L2)
not_2 = Not(x=isEmpty)
create = List.Create(item0=not_, item1=code_block, item2=not_2)
transpose = List.Transpose(lists=create)
binaryFromBooleans = Custom[CW.String.BinaryFromBooleans](VARbooleans=transpose)  # Creates a binary string from a list of booleans
string = StringInput("""111
000
100
101""")  # graph input
string_2 = StringInput("""Placed
Unplaced
Not enclosed
Redundant""")  # graph input
create_2 = List.Create(item0=string, item1=string_2)
string_3 = StringInput("\n")  # graph input
split = String.Split(str=create_2, separator0=string_3)
firstItem = List.FirstItem(list=split)
lastItem = List.LastItem(list=split)
matchWithKeyValues = Custom[CW.List.MatchWithKeyValues](VARseq=binaryFromBooleans, VARkeys=firstItem, VARvalues=lastItem)  # Matches a list with a given set of keys and returns the values corresponding to the keys
VARstate = Output(matchWithKeyValues)
