# Dynamo custom node CW.ScopeIf+.dyf (Dynamo 2.1.0.7500)
# category: Synthesize.Packages.Clockwork.Core.Logic.Actions
# A (hopefully) more robust implementation of ScopeIf. Tests a single boolean and returns a value accordingly.

VARtest = Input(VARtest: var[]..[])
VARtrue = Input(VARtrue: var[]..[])
VARfalse = Input(VARfalse: var[]..[])
python_script = Python(IN[0]=VARtest, IN[1]=VARtrue, IN[2]=VARfalse)
# ---------- python_script.python (27 lines) ----------
import clr
clr.AddReference('ProtoGeometry')
from Autodesk.DesignScript.Geometry import *
#The inputs to this node will be stored as a list in the IN variables.
dataEnteringNode = IN

def tolist(obj1):
	if hasattr(obj1,'__iter__'): return obj1
	else: return [obj1]

def flatten(x):
    result = []
    for el in x:
        if hasattr(el, "__iter__") and not isinstance(el, basestring):
            result.extend(flatten(el))
        else:
            result.append(el)
    return result

test = flatten(tolist(IN[0]))[0]
true = IN[1]
false = IN[2]

if test:
	OUT = true
else:
	OUT = false
# ----------------------------------------
python_null_2_empty = Custom[Python Null 2 Empty](VARIN=python_script)  # Python Null 2 Empty
VARresult = Output(python_null_2_empty)
