# Dynamo custom node CW.SelectionSet.ByElements.dyf (Dynamo 2.1.0.7500)
# category: Synthesize.Packages.Clockwork.Revit.Elements.SelectionSet.Create
# Creates a selection set of the given elements. Note that if a selection set of the given name already exists in the model, its contents will be replaced. Also, if the selection set is already applied as a view filter, the view filter will have to be manually updated in the visibility / graphic overrides. DO ***NOT*** USE IN AUTOMATIC MODE!

VARelements = Input(VARelements: var[]..[])
turnIntoList = Custom[CW.TurnIntoList](VARunknownItem=VARelements)  # Turns an element (or a nested list) into a flat list
VARName = Input(VARName: string)
python_script = Python(IN[0]=turnIntoList, IN[1]=VARName)
# ---------- python_script.python (55 lines) ----------
import clr
clr.AddReference('RevitAPI')
from Autodesk.Revit.DB import *
from System.Collections.Generic import *

clr.AddReference("RevitNodes")
import Revit
clr.ImportExtensions(Revit.Elements)

clr.AddReference("RevitServices")
import RevitServices
from RevitServices.Persistence import DocumentManager
from RevitServices.Transactions import TransactionManager

doc = DocumentManager.Instance.CurrentDBDocument
name = IN[1]

# create itemset
items = UnwrapElement(IN[0])
ids = list()
for item in items:
	ids.append(item.Id)
itemset = List[ElementId](ids)

# collect all existing filters from the model 
names = list()
collector = FilteredElementCollector(doc)
filters = collector.OfClass(FilterElement).ToElements();


TransactionManager.Instance.EnsureInTransaction(doc)

newfilters = []
for each in filters:
	if each.Name.lower().startswith("dynamo") and each.IsEmpty():
		doc.Delete(each.Id)
	else:
		newfilters.append(each)

filters = newfilters

selset = False

# if a filter of that name already exists, delete its content
for each in filters:
	if each.Name.lower() == name.lower():
		each.Clear()
		selset = each
# create a new selection set if it doesn't already exist
if selset == False:
	selset = SelectionFilterElement.Create(doc,name)
# add the items to the selection set
selset.AddSet(itemset)
TransactionManager.Instance.TransactionTaskDone()
OUT = selset.ToDSType(False),selset.Id
# ----------------------------------------
code_block = CodeBlock(a=python_script) { a[0]; a[1]; }
VARselectionSet = Output(code_block.out0)
VARselectionSetId = Output(code_block.out1)
