# Dynamo custom node CW.SelectionSet.Elements.dyf (Dynamo 2.1.0.7500)
# category: Synthesize.Packages.Clockwork.Revit.Elements.SelectionSet.Query
# Retrieves all elements stored in a selection set

VARselectionSet = Input(VARselectionSet: var[]..[])
turnIntoList = Custom[CW.TurnIntoList](VARunknownItem=VARselectionSet)  # Turns an element (or a nested list) into a flat list
python_script = Python(IN[0]=turnIntoList)
# ---------- python_script.python (12 lines) ----------
import clr
clr.AddReference('RevitAPI')
from Autodesk.Revit.DB import *

items = UnwrapElement(IN[0])
elementlist = list()
for item in items:
	selsetmembers = list()
	for member in item.GetElementIds():
		selsetmembers.append(item.Document.GetElement(member))
	elementlist.append(selsetmembers)
OUT = elementlist
# ----------------------------------------
returnListOrSingleValue = Custom[CW.ReturnListOrSingleValue](VARunknownItem=VARselectionSet, VARseq=python_script)  # If the unknown item is not a list but rather a single item, only the first item of the list (input "seq") will be returned.
VARelements = Output(returnListOrSingleValue)
