# Dynamo custom node CW.String.BinaryFromBooleans.dyf (Dynamo 2.1.0.7500)
# category: Synthesize.Packages.Clockwork.Core.String.Create
# Creates a binary string from a list of booleans

string = StringInput("")  # graph input
VARbooleans = Input(VARbooleans: var[]..[])
code_block = CodeBlock(test=VARbooleans) { test ? "1" : "0"; }
join = String.Join(separator=string, string0=code_block)
firstItem = List.FirstItem(list=join)
VARbinary = Output(firstItem)
