# Dynamo custom node CW.String.CompileRegularExpression.dyf (Dynamo 2.1.0.7500)
# category: Synthesize.Packages.Clockwork.Core.String.Actions
# This is a helper node for setting certain flags for the Regular Expresssion nodes.
# http://ironpython-test.readthedocs.org/en/latest/howto/regex.html

regExp = Input(regExp: string)  # Theregularexpression
string = StringInput("")  # graph input
ignoreCase = Input(ignoreCase: bool = false)  # Performcaseinsensitivematching
useLocale = Input(useLocale: bool = false)  # Treatspecialcharacterse.g.üfromthecurrentlysetsystemlocaleasletters
dotAll = Input(dotAll: bool = false)  # Make.matchanycharacterincludingnewlines
multilineMatching = Input(multilineMatching: bool = false)  # ^matchesatthebeginningofeachline$matchesattheendofeachline
create = List.Create(item0=ignoreCase, item1=useLocale, item2=dotAll, item3=multilineMatching)
code_block = CodeBlock { 1; 0; }
scopeIf = Custom[CW.ScopeIf+](VARtest=create, VARtrue=code_block.out0, VARfalse=code_block.out1)  # A (hopefully) more robust implementation of ScopeIf. Tests a single boolean and returns a value accordingly.
string_from_object = FromObject(obj=scopeIf)
join = String.Join(separator=string, string0=string_from_object)
firstItem = List.FirstItem(list=join)
python_script = Python(IN[0]=regExp, IN[1]=firstItem)
# ---------- python_script.python (39 lines) ----------
import clr
import re

regexstring = IN[0]
flags = IN[1]
# process flags
if flags == "1111":
	thisexp = re.compile(regexstring, re.IGNORECASE|re.LOCALE|re.DOTALL|re.MULTILINE)
elif flags == "1110":
	thisexp = re.compile(regexstring, re.IGNORECASE|re.LOCALE|re.DOTALL)
elif flags == "1101":
	thisexp = re.compile(regexstring, re.IGNORECASE|re.LOCALE|re.MULTILINE)
elif flags == "1100":
	thisexp = re.compile(regexstring, re.IGNORECASE|re.LOCALE)
elif flags == "1011":
	thisexp = re.compile(regexstring, re.IGNORECASE|re.DOTALL|re.MULTILINE)
elif flags == "1010":
	thisexp = re.compile(regexstring, re.IGNORECASE|re.DOTALL)
elif flags == "1001":
	thisexp = re.compile(regexstring, re.IGNORECASE|re.MULTILINE)
elif flags == "1000":
	thisexp = re.compile(regexstring, re.IGNORECASE)
elif flags == "0111":
	thisexp = re.compile(regexstring, re.LOCALE|re.DOTALL|re.MULTILINE)
elif flags == "0110":
	thisexp = re.compile(regexstring, re.LOCALE|re.DOTALL)
elif flags == "0101":
	thisexp = re.compile(regexstring, re.LOCALE|re.MULTILINE)
elif flags == "0100":
	thisexp = re.compile(regexstring, re.LOCALE)
elif flags == "0011":
	thisexp = re.compile(regexstring, re.DOTALL|re.MULTILINE)
elif flags == "0010":
	thisexp = re.compile(regexstring, re.DOTALL)
elif flags == "0001":
	thisexp = re.compile(regexstring, re.MULTILINE)
else:
	thisexp = re.compile(regexstring)
OUT = thisexp
# ----------------------------------------
compRegExp = Output(python_script)  # CompliedReguarExpressionflags
