# Dynamo custom node CW.String.FindRegularExpression.dyf (Dynamo 2.1.0.7500)
# category: Synthesize.Packages.Clockwork.Core.String.Actions
# Returns all occurences of a regular expression within a string (or list of strings). The syntax for regular expressions is explained at
# http://ironpython-test.readthedocs.org/en/latest/howto/regex.html

VARstr = Input(VARstr: string)
VARRegEx = Input(VARRegEx: string)
ignoreCase = Input(ignoreCase: bool = false)  # Performcaseinsensitivematching
useLocale = Input(useLocale: bool = false)  # Treatspecialcharacterse.g.üfromthecurrentlysetsystemlocaleasletters
dotAll = Input(dotAll: bool = false)  # Make.matchanycharacterincludingnewlines
multilineMatching = Input(multilineMatching: bool = false)  # ^matchesatthebeginningofeachline$matchesattheendofeachline
compileRegularExpression = Custom[CW.String.CompileRegularExpression](regExp=VARRegEx, ignoreCase=ignoreCase, useLocale=useLocale, dotAll=dotAll, multilineMatching=multilineMatching)  # This is a helper node for setting certain flags for the Regular Expresssion nodes. http://ironpython-test.readthedocs.org/en/latest/howto/regex.html
turnIntoList = Custom[CW.TurnIntoList](VARunknownItem=VARstr)  # Turns an element (or a nested list) into a flat list
python_script = Python(IN[0]=compileRegularExpression, IN[1]=turnIntoList)
# ---------- python_script.python (13 lines) ----------
import clr
import re

thisexp = IN[0]
regexlist = IN[1]
elementlist = list()
	
for item in regexlist:
	try:
		elementlist.append(thisexp.findall(item))
	except:
		elementlist.append(list())
OUT = elementlist
# ----------------------------------------
returnListOrSingleValue = Custom[CW.ReturnListOrSingleValue](VARunknownItem=VARstr, VARseq=python_script)  # If the unknown item is not a list but rather a single item, only the first item of the list (input "seq") will be returned.
VARseq = Output(returnListOrSingleValue)
