# Dynamo custom node CW.Surface.FilterByOrientation.dyf (Dynamo 2.1.0.7500)
# category: Synthesize.Packages.Clockwork.Geometry.Surface.Actions
# Sorts surfaces in three lists based on their orientation (vertical, horizontal up & horizontal down) and also returns three corresponding lists of booleans.

VARsurfaces = Input(VARsurfaces: Autodesk.DesignScript.Geometry.Surface[])
almostZero = Custom[CW.Math.AlmostZero]()  # Returns a feasable computational tolerance to zero (1.0e-9 or a billionth of 1) for use in calculations. More background info: https://github.com/DynamoDS/Dynamo/issues/879
ZAxisNegative = Custom[CW.Vector.ZAxisNegative]()  # Returns an XYZ of 0,0,-1
code_block = CodeBlock(surf=VARsurfaces, almostzero=almostZero, ZNeg=ZAxisNegative)
# ---------- code_block.designscript (11 lines) ----------
vec = surf.NormalAtParameter(0.5,0.5);
z = vec.Z;
// Vertical
mask1 = z >= (0 - almostzero) && z <= (0 + almostzero);
List.FilterByBoolMask(surf,mask1)["in"];
// Horizontal up
mask2 = vec.IsAlmostEqualTo(Vector.ZAxis());
List.FilterByBoolMask(surf,mask2)["in"];
// Horizontal down
mask3 = vec.IsAlmostEqualTo(ZNeg);
List.FilterByBoolMask(surf,mask3)["in"];
# ----------------------------------------
VARvertical = Output(code_block.out3)
VARisVertical = Output(code_block.mask1)
VARhorizontalUp = Output(code_block.out5)
VARisHorizontalUp = Output(code_block.mask2)
VARhorizontalDown = Output(code_block.out7)
VARisHorizontalDown = Output(code_block.mask3)
