# Dynamo custom node CW.Surface.IsPlanar.dyf (Dynamo 2.1.0.7500)
# category: Synthesize.Packages.Clockwork.Geometry.Surface.Query
# Checks whether a face is planar

VARsurface = Input(VARsurface: Autodesk.DesignScript.Geometry.Surface)
intersect = Geometry.Intersect()  # unwired: geometry, other
turnIntoList = Custom[CW.TurnIntoList](VARunknownItem=VARsurface)  # Turns an element (or a nested list) into a flat list
code_block = CodeBlock { 3; }
gridFromFace = Custom[CW.Paneling.GridFromFace](VARU=code_block, VARV=code_block)  # Returns UV coordinates, XYZ coordinates and normals for a face with UV subdivision; unwired: VARsurface
map = List.Map(list=turnIntoList, f_x=gridFromFace.VARPoints)
byBestFitThroughPoints = Plane.ByBestFitThroughPoints()  # unwired: points
map_2 = List.Map(list=map, f_x=byBestFitThroughPoints)
combine = List.Combine(comb=intersect, list1=map_2, list2=map)
isEmpty = List.IsEmpty()  # unwired: list
map_3 = List.Map(f_x=isEmpty)  # unwired: list
map_4 = List.Map(list=combine, f_x=map_3)
allFalse = List.AllFalse()  # unwired: list
map_5 = List.Map(list=map_4, f_x=allFalse)
returnListOrSingleValue = Custom[CW.ReturnListOrSingleValue](VARunknownItem=VARsurface, VARseq=map_5)  # If the unknown item is not a list but rather a single item, only the first item of the list (input "seq") will be returned.
VARbool = Output(returnListOrSingleValue)
