# Dynamo custom node CW.TurnIntoList.dyf (Dynamo 2.1.0.7500)
# category: Synthesize.Packages.Clockwork.Core.List.Create
# Turns an element (or a nested list) into a flat list

VARunknownItem = Input(VARunknownItem: var[]..[])
code_block = CodeBlock(item=VARunknownItem) { DSCore.List.Flatten([item]); }
python_null_2_empty = Custom[Python Null 2 Empty](VARIN=code_block)  # Python Null 2 Empty
VARseq = Output(python_null_2_empty)
