# Dynamo custom node CW.UV.PruneDuplicates.dyf (Dynamo 2.1.0.7500)
# category: Synthesize.Packages.Clockwork.Geometry.UV.Actions
# Prune UVs to exclude duplicates within a given tolerance

UVs = Input(UVs: Autodesk.DesignScript.Geometry.UV[])
Tolerance = Input(Tolerance: double)
code_block = CodeBlock(uvlist=UVs, tol=Tolerance)
# ---------- code_block.designscript (3 lines) ----------
plist1 = Autodesk.Point.ByCoordinates(uvlist.U,uvlist.V);
plist2 = Autodesk.Point.PruneDuplicates(plist1,tol);
UV.ByCoordinates(plist2.X,plist2.Y);
# ----------------------------------------
UVs_2 = Output(code_block.out2)  # "UVs"
