# Dynamo custom node CW.Vector.IsOrthogonalToVector.dyf (Dynamo 2.1.0.7500)
# category: Synthesize.Packages.Clockwork.Geometry.Vector.Query
# Checks if two vectors are orthogonal to each other

VARVector1 = Input(VARVector1: var[]..[])
VARVector2 = Input(VARVector2: var[]..[])
almostZero = Custom[CW.Math.AlmostZero]()  # Returns a feasable computational tolerance to zero (1.0e-9 or a billionth of 1) for use in calculations. More background info: https://github.com/DynamoDS/Dynamo/issues/879
code_block = CodeBlock(vec1=VARVector1, vec2=VARVector2, zero=almostZero)
# ---------- code_block.designscript (4 lines) ----------
dotprod = vec1.Normalized().Dot(vec2.Normalized());
// Orthogonal vectors have a dot product of zero
// We're adding a bit of tolerance, just to be on the safe side...
isortho = !(dotprod>zero) && !(dotprod < -zero);
# ----------------------------------------
VARbool = Output(code_block.isortho)
