# Dynamo custom node CW.View.ConvertTemporaryHideIsolateToPermanent.dyf (Dynamo 2.1.0.7500)
# category: Synthesize.Packages.Clockwork.Revit.Views.View.Actions
# Convert all temporary hidden elements or categories to permanently hidden in the given view.

VARview = Input(VARview: var[]..[])
python_script = Python(IN[0]=VARview)
# ---------- python_script.python (16 lines) ----------
import clr
clr.AddReference('RevitAPI')
from Autodesk.Revit.DB import *

clr.AddReference("RevitServices")
import RevitServices
from RevitServices.Persistence import DocumentManager
from RevitServices.Transactions import TransactionManager

doc = DocumentManager.Instance.CurrentDBDocument
view = UnwrapElement(IN[0])

TransactionManager.Instance.EnsureInTransaction(doc)
view.ConvertTemporaryHideIsolateToPermanent()
TransactionManager.Instance.TransactionTaskDone()
OUT = view
# ----------------------------------------
VARview_2 = Output(python_script)  # "VARview"
