# Dynamo custom node CW.View.DisableTemporaryHideIsolate.dyf (Dynamo 2.1.0.7500)
# category: Synthesize.Packages.Clockwork.Revit.Views.View.Actions
# Disables the temporary hide/isolate for the given view (if set)

VARview = Input(VARview: var[]..[])
python_script = Python(IN[0]=VARview)
# ---------- python_script.python (16 lines) ----------
import clr
clr.AddReference('RevitAPI')
from Autodesk.Revit.DB import *

clr.AddReference("RevitServices")
import RevitServices
from RevitServices.Persistence import DocumentManager
from RevitServices.Transactions import TransactionManager

doc = DocumentManager.Instance.CurrentDBDocument
view = UnwrapElement(IN[0])
TransactionManager.Instance.EnsureInTransaction(doc)
if view.IsTemporaryHideIsolateActive() == True:
	view.DisableTemporaryViewMode(TemporaryViewMode.TemporaryHideIsolate)
TransactionManager.Instance.TransactionTaskDone()
OUT = view
# ----------------------------------------
VARview_2 = Output(python_script)  # "VARview"
