# Dynamo custom node CW.View.ResetElementOverrides.dyf (Dynamo 2.1.0.7500)
# category: Synthesize.Packages.Clockwork.Revit.Views.View.Actions
# Resets all overrides for an element in a given view

VARelement = Input(VARelement: var[]..[])
turnIntoList = Custom[CW.TurnIntoList](VARunknownItem=VARelement)  # Turns an element (or a nested list) into a flat list
VARview = Input(VARview: var[]..[])
python_script = Python(IN[0]=turnIntoList, IN[1]=VARview)
# ---------- python_script.python (28 lines) ----------
import clr
clr.AddReference('RevitAPI')
from Autodesk.Revit.DB import *

clr.AddReference("RevitNodes")
import Revit
clr.ImportExtensions(Revit.Elements)

clr.AddReference("RevitServices")
import RevitServices
from RevitServices.Persistence import DocumentManager
from RevitServices.Transactions import TransactionManager

doc = DocumentManager.Instance.CurrentDBDocument
items = UnwrapElement(IN[0])
view = UnwrapElement(IN[1])
booleans = []

override = OverrideGraphicSettings()

TransactionManager.Instance.EnsureInTransaction(doc)
for item in items:
	try:
		view.SetElementOverrides(item.Id, override)
		booleans.append(True)
	except: booleans.append(False)
TransactionManager.Instance.TransactionTaskDone()
OUT = (items,view,booleans)
# ----------------------------------------
code_block = CodeBlock(seq=python_script) { seq[0]; seq[1]; seq[2]; }
returnListOrSingleValue = Custom[CW.ReturnListOrSingleValue](VARunknownItem=VARelement, VARseq=code_block.out0)  # If the unknown item is not a list but rather a single item, only the first item of the list (input "seq") will be returned.
VARelement_2 = Output(returnListOrSingleValue)  # "VARelement"
VARview_2 = Output(code_block.out1)  # "VARview"
returnListOrSingleValue_2 = Custom[CW.ReturnListOrSingleValue](VARunknownItem=VARelement, VARseq=code_block.out2)
VARsuccess = Output(returnListOrSingleValue_2)
