# Dynamo custom node Change Family Category.dyf (Dynamo 2.1.0.7500)
# category: Synthesize.Automate.Family
# Change Family Category

VARCategory = Input(VARCategory: var[]..[])
VARFamilyTypes = Input(VARFamilyTypes: var[]..[])
python_script = Python(IN[0]=VARCategory, IN[1]=VARFamilyTypes)
# ---------- python_script.python (83 lines) ----------
# Created By Karam Baki : karam@aecedx.com
# Enable Python support and load DesignScript library
# IMPORTANT : ALL DYNAMO DESIGN SCRIPT NODES ARE AS (dg)
import clr
clr.AddReference('ProtoGeometry')
from Autodesk.DesignScript import Geometry as dg

# EXTENSION Enable ToDSType
clr.AddReference('RevitNodes')
import Revit
clr.ImportExtensions(Revit.Elements)

# Enable Revit Elements
from Revit.Elements import *

# EXTENSION Enable Geometry Conversion Methods
clr.ImportExtensions(Revit.GeometryConversion)

# Enable Revit API
clr.AddReference('RevitAPI')
from Autodesk.Revit.DB import *

# Enable DocumentManager and TransactionManager
clr.AddReference('RevitServices')
from RevitServices.Persistence import DocumentManager
from RevitServices.Transactions import TransactionManager

# Enable ICollection List Translate
clr.AddReference("System")
import System.Collections.Generic
from System.Collections.Generic import List

import sys
sys.path.append(r'C:\Program Files (x86)\IronPython 2.7\DLLs')
sys.path.append(r'C:\Program Files (x86)\IronPython 2.7\Lib')
from collections import Iterable

doc = DocumentManager.Instance.CurrentDBDocument
app = doc.Application

class FamOpt1(IFamilyLoadOptions):
	def __init__(self):
		pass
	def OnFamilyFound(self,familyInUse, overwriteParameterValues):
		return True
	def OnSharedFamilyFound(self,familyInUse, source, overwriteParameterValues):
		return True

def tolist(obj1):
	if hasattr(obj1,'__iter__'): return obj1
	else: return [obj1]

def flatten(x):
    result = []
    for el in x:
        if hasattr(el, "__iter__") and not isinstance(el, basestring):
            result.extend(flatten(el))
        else:
            result.append(el)
    return result

cat = UnwrapElement(IN[0])
familytype = UnwrapElement(flatten(tolist(IN[1])))

def changecat(cat,familytype):
	transac = TransactionManager.Instance
	transac.ForceCloseTransaction()
	famdoc = doc.EditFamily(familytype.Family)
	transac.EnsureInTransaction(famdoc)
	try:
		fam_cat = famdoc.Settings.Categories.get_Item(cat.Name)
		famdoc.OwnerFamily.FamilyCategory = fam_cat
		transac.ForceCloseTransaction()
		family1 = famdoc.LoadFamily(doc, FamOpt1() )
		famdoc.Close(False)
	except:
		transac.ForceCloseTransaction()
		famdoc.Close(False)

for e in familytype:
	changecat(cat,e)

OUT = "Done"
# ----------------------------------------
VAROut = Output(python_script)
