# Dynamo custom node Confirm Element Position By Geometry.dyf (Dynamo 2.1.0.7500)
# category: Synthesize.Automate.Family
# Confirm Element Position By Geometry

VAROriginalGeometry = Input(VAROriginalGeometry: var[]..[])
VARElement = Input(VARElement: var[]..[])
python_script = Python(IN[0]=VAROriginalGeometry, IN[1]=VARElement)
# ---------- python_script.python (63 lines) ----------
# Enable Python support and load DesignScript library
# IMPORTANT : ALL DYNAMO DESIGN SCRIPT NODES ARE AS (dg)
import clr
clr.AddReference('ProtoGeometry')
from Autodesk.DesignScript import Geometry as dg

# EXTENSION Enable ToDSType
clr.AddReference('RevitNodes')
import Revit
clr.ImportExtensions(Revit.Elements)

# Enable Revit Elements
from Revit.Elements import *

# EXTENSION Enable Geometry Conversion Methods
clr.ImportExtensions(Revit.GeometryConversion)

# Enable Revit API
clr.AddReference('RevitAPI')
from Autodesk.Revit.DB import *

# Enable DocumentManager and TransactionManager
clr.AddReference('RevitServices')
from RevitServices.Persistence import DocumentManager
from RevitServices.Transactions import TransactionManager

# Enable ICollection List Translate
clr.AddReference("System")
import System.Collections.Generic
from System.Collections.Generic import List

dataEnteringNode = IN
# Use UnwrapElement(IN[0]) When Translating From Dynamo to Revit
original=UnwrapElement(IN[0])
elem=UnwrapElement(IN[1])

# Choose The Current Document
doc = DocumentManager.Instance.CurrentDBDocument
uidoc = DocumentManager.Instance.CurrentUIApplication.ActiveUIDocument
uiapp = DocumentManager.Instance.CurrentUIApplication
app = uiapp.Application

# Create Empty List
result = []

try:
	bboxorig = dg.BoundingBox.ByGeometry(original)
	mid = dg.Curve.PointAtParameter(dg.Line.ByStartPointEndPoint(bboxorig.MinPoint,bboxorig.MaxPoint),0.5)
	
	elembbox = elem.get_BoundingBox(None).ToProtoType()
	midelem = dg.Curve.PointAtParameter(dg.Line.ByStartPointEndPoint(elembbox.MinPoint,elembbox.MaxPoint),0.5)
	
	if dg.Geometry.DistanceTo(midelem,mid) > 0.05:
		line = dg.Line.ByStartPointEndPoint(midelem,mid)
		tran = dg.Geometry.Transform(line,dg.CoordinateSystem.ByOrigin(line.StartPoint),dg.CoordinateSystem.ByOrigin(0,0,0)).EndPoint.ToXyz()
		TransactionManager.Instance.EnsureInTransaction(doc)
		elem.Location.Move(tran)
		TransactionManager.Instance.TransactionTaskDone()
except:
	pass

# Assign your output to the OUT variable.
OUT = elem
# ----------------------------------------
VAROut = Output(python_script)
