# Dynamo custom node Contour Model Create.dyf (Dynamo 2.1.0.7500)
# category: Synthesize.Automate.Topography
# Contour Model Create

VARSmoothLines = Input(VARSmoothLines: bool = false)
code_block = CodeBlock { false; }
VARPointsDistancing = Input(VARPointsDistancing: double = 1)
VARTopography = Input(VARTopography: var[]..[])
VARGoWithGeom = Input(VARGoWithGeom: var[]..[])
polySurface = Custom[ZK.Topography.PolySurface](VARTopography=VARTopography, VARFullTopo=VARGoWithGeom)  # Convert topography element to polysurface
smooth_curves = Custom[Smooth Curves](VARForceClose=code_block, VARPointsDistance=VARPointsDistancing, VARCurves=polySurface.VARPolyCurves, VARSmoothMode=VARSmoothLines)  # Smooth Curves
scopeIf = Custom[CW.ScopeIf+](VARtest=VARSmoothLines, VARtrue=smooth_curves, VARfalse=polySurface.VARPolyCurves)  # A (hopefully) more robust implementation of ScopeIf. Tests a single boolean and returns a value accordingly.
isClosed = Curve.IsClosed(curve=scopeIf)
filterByBoolMask = List.FilterByBoolMask(list=scopeIf, mask=isClosed)
python_script = Python(IN[0]=VARTopography)
# ---------- python_script.python (48 lines) ----------
# Enable Python support and load DesignScript library
# IMPORTANT : ALL DYNAMO DESIGN SCRIPT NODES ARE AS (dg)
import clr
clr.AddReference('ProtoGeometry')
from Autodesk.DesignScript import Geometry as dg

# EXTENSION Enable ToDSType
clr.AddReference('RevitNodes')
import Revit
clr.ImportExtensions(Revit.Elements)

# Enable Revit Elements
from Revit.Elements import *

# EXTENSION Enable Geometry Conversion Methods
clr.ImportExtensions(Revit.GeometryConversion)

# Enable Revit API
clr.AddReference('RevitAPI')
from Autodesk.Revit.DB import *

# Enable DocumentManager and TransactionManager
clr.AddReference('RevitServices')
from RevitServices.Persistence import DocumentManager
from RevitServices.Transactions import TransactionManager

# Enable ICollection List Translate
clr.AddReference("System")
import System.Collections.Generic
from System.Collections.Generic import List

dataEnteringNode = IN
# Use UnwrapElement(IN[0]) When Translating From Dynamo to Revit
topo=UnwrapElement(IN[0])

# Choose The Current Document
doc = DocumentManager.Instance.CurrentDBDocument
uidoc = DocumentManager.Instance.CurrentUIApplication.ActiveUIDocument
uiapp = DocumentManager.Instance.CurrentUIApplication
app = uiapp.Application

# Create Empty List
result = []
points = Architecture.TopographySurface.GetBoundaryPoints(topo)
for each in points:
	result.append(each.ToPoint())
# Assign your output to the OUT variable.
OUT = result
# ----------------------------------------
pruneDuplicates = Point.PruneDuplicates(points=python_script)
perimeterCurves = Surface.PerimeterCurves(surface=polySurface.VARPolySurface)
byJoinedCurves = PolyCurve.ByJoinedCurves(curves=perimeterCurves)
isNull = Object.IsNull(obj=byJoinedCurves)
empty = List.Empty()
scopeIf_2 = Custom[CW.ScopeIf+](VARtest=isNull, VARtrue=perimeterCurves, VARfalse=empty)
as_polycurve_bycurves = Custom[AS.[&] PolyCurve.ByCurves](VARcurves=scopeIf_2)  # Create polycurves from an unordered list of curves.
numberOfCurves = PolyCurve.NumberOfCurves(polyCurve=as_polycurve_bycurves.VARpolyCurve)
maximumItem = List.MaximumItem(list=numberOfCurves)
eq = maximumItem == numberOfCurves
filterByBoolMask_2 = List.FilterByBoolMask(list=as_polycurve_bycurves.VARpolyCurve, mask=eq)
scopeIf_3 = Custom[CW.ScopeIf+](VARtest=isNull, VARtrue=filterByBoolMask_2.in, VARfalse=byJoinedCurves)
sort_geometry_by_guides = Custom[Sort Geometry By Guides](VARGeometries=pruneDuplicates, VARGuides=scopeIf_3)  # Sort Loft Profiles According to Guide
as_list_sortbykey = Custom[AS.[&] List.SortByKey](VARlist=pruneDuplicates, VARkeys=sort_geometry_by_guides.VARKeys)  # Sort a list (or lists) according to the order specified by the key list.
code_block_2 = CodeBlock { true; }
byPoints = PolyCurve.ByPoints(points=as_list_sortbykey.VARsortedlist, connectLastToFirst=code_block_2)
join = List.Join()  # unwired: list0, list1
startPoint = Curve.StartPoint(curve=filterByBoolMask.out)
endPoint = Curve.EndPoint(curve=filterByBoolMask.out)
combine = List.Combine(comb=join, list1=startPoint, list2=endPoint)
doesIntersect = Geometry.DoesIntersect(geometry=byPoints, other=combine, lacing=Longest)
allTrue = List.AllTrue(list=doesIntersect@L2)
filterByBoolMask_3 = List.FilterByBoolMask(list=filterByBoolMask.out, mask=allTrue)
isEmpty = List.IsEmpty(list=filterByBoolMask_3.out)
VARIsThereProblem = Output(isEmpty)
curves = PolyCurve.Curves(polyCurve=byPoints)
boundingBox = Element.BoundingBox(element=VARTopography)
toCuboid = BoundingBox.ToCuboid(boundingBox=boundingBox)
explode = Geometry.Explode(geometry=toCuboid)
filterByOrientation = Custom[CW.Surface.FilterByOrientation](VARsurfaces=explode)  # Sorts surfaces in three lists based on their orientation (vertical, horizontal up & horizontal down) and also returns three corresponding lists of booleans.
pointAtParameter = Surface.PointAtParameter(surface=filterByOrientation.VARhorizontalDown)
XYZ = Custom[LF.Point.XYZ](VARpoint=pointAtParameter)  # Get the X, Y, and Z components of a Point
extra_depth = DoubleInput(-5)  # graph input
add = XYZ.VARZ + extra_depth
code_block_3 = CodeBlock(a=add) { a[0]; }
byCoordinates = Point.ByCoordinates(z=code_block_3)
byOriginNormal = Plane.ByOriginNormal(origin=byCoordinates)
pullOntoPlane = Curve.PullOntoPlane(curve=curves, plane=byOriginNormal)
byJoinedCurves_2 = PolyCurve.ByJoinedCurves(curves=pullOntoPlane)
byPatch = Surface.ByPatch(closedCurve=byJoinedCurves_2)
join_2 = List.Join()  # unwired: list0, list1
VARSegmentLines = Input(VARSegmentLines: bool = false)
VARProceed = Input(VARProceed: var[]..[])
create = List.Create(item0=filterByBoolMask.in, item1=filterByBoolMask_3.in)
code_block_4 = CodeBlock { false; }
clean = List.Clean(list=create, preserveIndices=code_block_4)
flatten = List.Flatten(list=clean)
empty_2 = List.Empty()
scopeIf_4 = Custom[CW.ScopeIf+](VARtest=VARProceed, VARtrue=flatten, VARfalse=empty_2)
length = Curve.Length(curve=scopeIf_4)
VARSegmentsDistance = Input(VARSegmentsDistance: var[]..[])
div = length / VARSegmentsDistance
floor = Math.Floor(number=div)
VARMinimumSegments = Input(VARMinimumSegments: double = 1)
lt = _ < VARMinimumSegments  # unwired: x
replaceByCondition = Replace(item=floor, replaceWith=VARMinimumSegments, condition=lt)
sequence = Sequence(amount=replaceByCondition, lacing=Longest)
code_block_5 = CodeBlock { 0; 1; }
remapRange = Math.RemapRange(numbers=sequence, newMin=code_block_5.out0, newMax=code_block_5.out1)
pointAtParameter_2 = Curve.PointAtParameter(curve=scopeIf_4, param=remapRange)
byPoints_2 = PolyCurve.ByPoints(points=pointAtParameter_2)
scopeIf_5 = Custom[CW.ScopeIf+](VARtest=VARSegmentLines, VARtrue=byPoints_2, VARfalse=scopeIf_4)
code_block_6 = CodeBlock { -1; }
byCoordinates_2 = Vector.ByCoordinates(z=code_block_6)
abs = Math.Abs(number=code_block_3)
code_block_7 = CodeBlock(a=abs) { a*2; }
translate = Geometry.Translate(geometry=byCoordinates, direction=byCoordinates_2, distance=code_block_7)
byOriginNormal_2 = Plane.ByOriginNormal(origin=translate)
pullOntoPlane_2 = Curve.PullOntoPlane(curve=scopeIf_5, plane=byOriginNormal_2)
combine_2 = List.Combine(comb=join_2, list1=scopeIf_5, list2=pullOntoPlane_2)
byLoft = Surface.ByLoft(crossSections=combine_2)
as_geometry_splitbytools = Custom[AS.[&] Geometry.SplitByTools](VARgeometry=byPatch, VARtools=byLoft)  # Split one piece of geometry (other than a polysurface) by multiple tools
perimeterCurves_2 = Surface.PerimeterCurves(surface=as_geometry_splitbytools)
as_polycurve_bycurves_2 = Custom[AS.[&] PolyCurve.ByCurves](VARcurves=perimeterCurves_2)
flatten_2 = List.Flatten(list=as_polycurve_bycurves_2.VARpolyCurve)
pullOntoPlane_3 = Curve.PullOntoPlane(curve=scopeIf_5, plane=byOriginNormal)
combine_3 = List.Combine(comb=join_2, list1=scopeIf_5, list2=pullOntoPlane_3)
byLoft_2 = Surface.ByLoft(crossSections=combine_3)
contour_loft_surfaces_with = Custom[Contour Loft Surfaces With PolyCurves Function](VARPolyCurves=flatten_2, VARLoftSurfaces=byLoft_2, VARGoWithGeom=VARGoWithGeom)  # Contour Loft Surfaces With PolyCurves Function
VARCurves = Output(contour_loft_surfaces_with.VARPolyCurves)
VARHeights = Output(contour_loft_surfaces_with.VARHeights)
VARSolid = Output(contour_loft_surfaces_with.VARSolid)
