# Dynamo custom node Convert Curve to Nurbs Curve With Resolution.dyf (Dynamo 2.1.0.7500)
# category: Synthesize.Automate.Lines
# Convert Curve to Nurbs Curve With Resolution

VARCurves = Input(VARCurves: var[]..[])
turnIntoList = Custom[CW.TurnIntoList](VARunknownItem=VARCurves)  # Turns an element (or a nested list) into a flat list
VARResolution = Input(VARResolution: var[]..[])
python_script = Python(IN[0]=turnIntoList, IN[1]=VARResolution)
# ---------- python_script.python (72 lines) ----------
# Enable Python support and load DesignScript library
# IMPORTANT : ALL DYNAMO DESIGN SCRIPT NODES ARE AS (dg)
import clr
clr.AddReference('ProtoGeometry')
from Autodesk.DesignScript import Geometry as dg

# EXTENSION Enable ToDSType
clr.AddReference('RevitNodes')
import Revit
clr.ImportExtensions(Revit.Elements)

# Enable Revit Elements
from Revit.Elements import *

# EXTENSION Enable Geometry Conversion Methods
clr.ImportExtensions(Revit.GeometryConversion)

# Enable Revit API
clr.AddReference('RevitAPI')
from Autodesk.Revit.DB import *

# Enable DocumentManager and TransactionManager
clr.AddReference('RevitServices')
from RevitServices.Persistence import DocumentManager
from RevitServices.Transactions import TransactionManager

# Enable ICollection List Translate
clr.AddReference("System")
import System.Collections.Generic
from System.Collections.Generic import List

dataEnteringNode = IN
# Use UnwrapElement(IN[0]) When Translating From Dynamo to Revit
curves=UnwrapElement(IN[0])
resolution=UnwrapElement(IN[1])

# Choose The Current Document
doc = DocumentManager.Instance.CurrentDBDocument
uidoc = DocumentManager.Instance.CurrentUIApplication.ActiveUIDocument
uiapp = DocumentManager.Instance.CurrentUIApplication
app = uiapp.Application

def normalize(length):
	if length != None:
		if length < 4:
			length = 4
		a = range(0,int(length))
		points = []
		amin, amax = min(a), max(a)
		item = []
		for val in a:
			item.append(float(val-amin) / float(amax-amin))
	else:
		item = [None]
	return item

# Create Empty List
result = []

for c in curves:
	try:
		clen = c.Length
		wantednum = round(clen/resolution)
		nums = normalize(wantednum)
		pts = []
		for n in nums:
			pts.append(dg.Curve.PointAtParameter(c,n))
		result.append(dg.NurbsCurve.ByControlPoints(pts))
	except:
		result.append(c)
# Assign your output to the OUT variable.
OUT = result
# ----------------------------------------
VARNurbsCurves = Output(python_script)
