# Dynamo custom node Coordinate System Adaptive Curves Prepare.dyf (Dynamo 2.1.0.7500)
# category: Synthesize.Automate.Adaptive
# Coordinate System Adaptive Curves Prepare

VARCurves = Input(VARCurves: Autodesk.DesignScript.Geometry.Curve[])
flatten = List.Flatten(list=VARCurves)
length = Curve.Length(curve=flatten)
VARSpacing = Input(VARSpacing: var[]..[])
div = length / VARSpacing
round = Math.Round(number=div)
VARMinimumNumber = Input(VARMinimumNumber: double = 1)
lt = _ < VARMinimumNumber  # unwired: x
replaceByCondition = Replace(item=round, replaceWith=VARMinimumNumber, condition=lt)
sequence = Sequence(amount=replaceByCondition, lacing=Longest)
code_block = CodeBlock { 0; 1; }
remapRange = Math.RemapRange(numbers=sequence, newMin=code_block.out0, newMax=code_block.out1)
pointAtParameter = Curve.PointAtParameter(curve=flatten, param=remapRange)
code_block_2 = CodeBlock { 1; }
byCoordinates = Vector.ByCoordinates(z=code_block_2)
tangentAtParameter = Curve.TangentAtParameter(curve=flatten, param=remapRange)
VARRotationDegree = Input(VARRotationDegree: double)
rotate = Vector.Rotate(vector=byCoordinates, axis=tangentAtParameter, degrees=VARRotationDegree)
byOriginNormalXAxis = Plane.ByOriginNormalXAxis(origin=pointAtParameter, normal=rotate, xAxis=tangentAtParameter)
XAxis = Plane.XAxis(plane=byOriginNormalXAxis)
YAxis = Plane.YAxis(plane=byOriginNormalXAxis)
byOriginVectors = CoordinateSystem.ByOriginVectors(origin=pointAtParameter, xAxis=XAxis, yAxis=YAxis)
code_block_3 = CodeBlock { false; }
clean = List.Clean(list=byOriginVectors, preserveIndices=code_block_3)
VARCoordinateSystem = Output(clean)
