# Dynamo custom node Coordinate System Global Z Then Host XY.dyf (Dynamo 2.1.0.7500)
# category: Synthesize.Automate.Adaptive
# Coordinate System Global Z Then Host XY

VARCoordinateSystem = Input(VARCoordinateSystem: var[]..[])
origin = CoordinateSystem.Origin(coordinateSystem=VARCoordinateSystem)
byOriginNormal = Plane.ByOriginNormal(origin=origin)
YAxis = CoordinateSystem.YAxis(coordinateSystem=VARCoordinateSystem)
code_block = CodeBlock { 100; }
unit_types = UnitTypes("Length")
displayUnitType = Custom[CW.UnitType.DisplayUnitType](VARunitType=unit_types)  # Retrieves the display unit type for a given unit type.
toDisplayUnit = Custom[CW.InternalUnit.ToDisplayUnit](VARval=code_block, VARdisplayUnitType=displayUnitType.VARdisplayUnitType)  # Converts a value from Revit's internal unit to a given display unit
byStartPointDirectionLength = Line.ByStartPointDirectionLength(startPoint=origin, direction=YAxis, length=toDisplayUnit)
startPoint = Curve.StartPoint(curve=byStartPointDirectionLength)
closestPointTo = Geometry.ClosestPointTo(geometry=byOriginNormal, other=startPoint)
endPoint = Curve.EndPoint(curve=byStartPointDirectionLength)
closestPointTo_2 = Geometry.ClosestPointTo(geometry=byOriginNormal, other=endPoint)
byTwoPoints = Vector.ByTwoPoints(start=closestPointTo, end=closestPointTo_2)
byOriginNormalXAxis = Plane.ByOriginNormalXAxis(origin=origin, xAxis=byTwoPoints)
byOriginNormal_2 = Plane.ByOriginNormal(origin=origin)
XAxis = CoordinateSystem.XAxis(coordinateSystem=VARCoordinateSystem)
byStartPointDirectionLength_2 = Line.ByStartPointDirectionLength(startPoint=origin, direction=XAxis, length=toDisplayUnit)
startPoint_2 = Curve.StartPoint(curve=byStartPointDirectionLength_2)
closestPointTo_3 = Geometry.ClosestPointTo(geometry=byOriginNormal_2, other=startPoint_2)
endPoint_2 = Curve.EndPoint(curve=byStartPointDirectionLength_2)
closestPointTo_4 = Geometry.ClosestPointTo(geometry=byOriginNormal_2, other=endPoint_2)
byTwoPoints_2 = Vector.ByTwoPoints(start=closestPointTo_3, end=closestPointTo_4)
byOriginNormalXAxis_2 = Plane.ByOriginNormalXAxis(origin=origin, xAxis=byTwoPoints_2)
isNull = Object.IsNull()  # unwired: obj
replaceByCondition = Replace(item=byOriginNormalXAxis, replaceWith=byOriginNormalXAxis_2, condition=isNull)
byPlane = CoordinateSystem.ByPlane(plane=replaceByCondition)
VARCoordinateSystem_2 = Output(byPlane)  # "VARCoordinateSystem"
