# Dynamo custom node Coordinate System Smart Flip.dyf (Dynamo 2.1.0.7500)
# category: Synthesize.Automate.Adaptive
# Coordinate System Smart Flip

VARFamilyType = Input(VARFamilyType: var[]..[])
adaptive_family_orientation_type = Custom[Adaptive Family Orientation Type](VARFamilyType=VARFamilyType)  # Adaptive Family Orientation Type
firstItem = List.FirstItem(list=adaptive_family_orientation_type.VARParameterNumbers)
VARFlip = Input(VARFlip: var[]..[])
python_script = Python(IN[0]=firstItem, IN[1]=VARFlip)
# ---------- python_script.python (50 lines) ----------
import clr
clr.AddReference('ProtoGeometry')
from Autodesk.DesignScript.Geometry import *
#The inputs to this node will be stored as a list in the IN variables.

orientstatus = IN[0]
flipstatus = IN[1]

if orientstatus == 9:
	if flipstatus == True:
		flipcoor = False
		flip = True
	else:
		flipcoor = False
		flip = False

elif orientstatus == 8:
	if flipstatus == True:
		flipcoor = False
		flip = True
	else:
		flipcoor = True
		flip = False

elif orientstatus == 2:
	if flipstatus == True:
		flipcoor = True
		flip = False
	else:
		flipcoor = False
		flip = False

elif orientstatus == 3:
	if flipstatus == True:
		flipcoor = False
		flip = True
	else:
		flipcoor = False
		flip = False

else:
	if flipstatus == True:
		flipcoor = False
		flip = True
	else:
		flipcoor = False
		flip = False

#Assign your output to the OUT variable.
OUT = flipcoor, flip
# ----------------------------------------
code_block = CodeBlock(a=python_script) { a[0]; }
VARFlipCoordinateSystemBool = Output(code_block)
code_block_2 = CodeBlock(b=python_script) { b[1]; }
VARFlipParameterBool = Output(code_block_2)
code_block_3 = CodeBlock { 6; }
eq = firstItem == code_block_3
VARIsGlobalZThenHostXYBool = Output(eq)
count = List.Count(list=adaptive_family_orientation_type.VARParameterNumbers)
VARNumberOfApativePoints = Output(count)
