# Dynamo custom node Coordination Family Management.dyf (Dynamo 2.1.0.7500)
# category: Synthesize.Automate.Coordination
# Coordination Management

VARDeleteUnusedCoordinationFamily = Input(VARDeleteUnusedCoordinationFamily: var[]..[])
VARFamilyType = Input(VARFamilyType: var[]..[])
all_elements_of_family_type = ElementsOfFamilyType(Family_Type=VARFamilyType)
VARFamilyInfoParameterName = Input(VARFamilyInfoParameterName: string)
getParameterValueByName = Element.GetParameterValueByName(element=all_elements_of_family_type, parameterName=VARFamilyInfoParameterName)
code_block = CodeBlock { ":"; }
split = String.Split(str=getParameterValueByName, separator0=code_block)
lastItem = List.LastItem(list=split@L2)
toNumber = String.ToNumber(str=lastItem)
al_current_document = Custom[AL.Current Document]()  # Retrieves Current Document
byID = Custom[CW.Element.ByID](VARIDUniqueId=toNumber, VARdocOrRevitLinkInstance=al_current_document)  # Gets the Revit element(s) for a list of IDs (or a single ID). Optionally retrieves elements from linked documents as well.
isNull = Object.IsNull(obj=byID)
filterByBoolMask = List.FilterByBoolMask(list=all_elements_of_family_type, mask=isNull)
empty = List.Empty()
scopeIf = Custom[CW.ScopeIf+](VARtest=VARDeleteUnusedCoordinationFamily, VARtrue=filterByBoolMask.in, VARfalse=empty)  # A (hopefully) more robust implementation of ScopeIf. Tests a single boolean and returns a value accordingly.
eraser = Custom[ST.Tool.Eraser](VARList=scopeIf)  # Try to delete any element from project
VARElementsToPlaceCoordination = Input(VARElementsToPlaceCoordination: var[]..[])
removeListFromList = Custom[RH.RemoveListFromList](VARListA=VARElementsToPlaceCoordination, VARListB=all_elements_of_family_type)  # This node essentially "subtracts" the contents of List B from List A to produce a new list with the unique items.
flatten = List.Flatten(list=removeListFromList)
code_block_2 = CodeBlock { true; }
location_of_any_element = Custom[Location Of Any Element](VARElements=flatten, VARGetAllPointsOfAdaptiveComponents=code_block_2)  # Location Of Any Element
filterByBoolMask_2 = List.FilterByBoolMask(list=byID, mask=isNull)
contains = List.Contains(list=location_of_any_element.VARElements, item=filterByBoolMask_2.out@@L1)
filterByBoolMask_3 = List.FilterByBoolMask(list=filterByBoolMask.out, mask=contains)
eraser_2 = Custom[ST.Tool.Eraser](VARList=filterByBoolMask_3.in)
VARXParameter = Input(VARXParameter: string)
code_block_3 = CodeBlock { 2; }
normalizeDepth = List.NormalizeDepth(list=location_of_any_element.VARLocations, rank=code_block_3)
byPoint = FamilyInstance.ByPoint(familyType=VARFamilyType, point=normalizeDepth)
firstItem = List.FirstItem(list=byPoint)
turnIntoList = Custom[CW.TurnIntoList](VARunknownItem=firstItem)  # Turns an element (or a nested list) into a flat list
parameterExists = Custom[CW.Element.ParameterExists](VARparam=VARXParameter, VARelement=turnIntoList)  # Checks if an element contains a parameter of a given name
empty_2 = List.Empty()
scopeIf_2 = Custom[CW.ScopeIf+](VARtest=parameterExists, VARtrue=byPoint, VARfalse=empty_2)
VARInternalOriginIs1ProjectBasePointIs2S = Input(VARInternalOriginIs1ProjectBasePointIs2SurveyPointIs3: var[]..[])
basePoint = Coordinates.BasePoint()
byOrigin = CoordinateSystem.ByOrigin(origin=basePoint)
byOrigin_2 = CoordinateSystem.ByOrigin()
transform = Geometry.Transform(geometry=normalizeDepth, fromCoordinateSystem=byOrigin, contextCoordinateSystem=byOrigin_2)
surveyPoint = Coordinates.SurveyPoint()
byOrigin_3 = CoordinateSystem.ByOrigin(origin=surveyPoint)
transform_2 = Geometry.Transform(geometry=normalizeDepth, fromCoordinateSystem=byOrigin_3, contextCoordinateSystem=byOrigin_2)
python_script = Python(IN[0]=VARInternalOriginIs1ProjectBasePointIs2S, IN[1]=normalizeDepth, IN[2]=transform, IN[3]=transform_2)
# ---------- python_script.python (24 lines) ----------
import clr
clr.AddReference('ProtoGeometry')
from Autodesk.DesignScript.Geometry import *
#The inputs to this node will be stored as a list in the IN variables.
dataEnteringNode = IN

bool = IN[0]
internal = IN[1]
base = IN[2]
survey = IN[3]

if bool == 1:
	result = internal
	report = "Internal Origin"
elif bool == 2:
	result = base
	report = "Project Base Point"
elif bool ==3:
	result = survey
	report = "Survey Point"


#Assign your output to the OUT variable.
OUT = result, report
# ----------------------------------------
code_block_4 = CodeBlock(a=python_script) { a[0]; a[1]; }
XYZ = Custom[LF.Point.XYZ](VARpoint=code_block_4.out0)  # Get the X, Y, and Z components of a Point
VARprecision = Input(VARprecision: double)
roundToPrecision = Custom[CW.Math.RoundToPrecision](VARdbl=XYZ.VARX, VARprecision=VARprecision)  # Rounds a number to a specified precision
setParameterByName = Element.SetParameterByName(element=scopeIf_2, parameterName=VARXParameter, value=roundToPrecision)
VARZParameter = Input(VARZParameter: string)
parameterExists_2 = Custom[CW.Element.ParameterExists](VARparam=VARZParameter, VARelement=turnIntoList)
scopeIf_3 = Custom[CW.ScopeIf+](VARtest=parameterExists_2, VARtrue=byPoint, VARfalse=empty_2)
roundToPrecision_2 = Custom[CW.Math.RoundToPrecision](VARdbl=XYZ.VARY, VARprecision=VARprecision)
setParameterByName_2 = Element.SetParameterByName(element=scopeIf_3, parameterName=VARZParameter, value=roundToPrecision_2)
VARYParameter = Input(VARYParameter: string)
parameterExists_3 = Custom[CW.Element.ParameterExists](VARparam=VARYParameter, VARelement=turnIntoList)
scopeIf_4 = Custom[CW.ScopeIf+](VARtest=parameterExists_3, VARtrue=byPoint, VARfalse=empty_2)
roundToPrecision_3 = Custom[CW.Math.RoundToPrecision](VARdbl=XYZ.VARZ, VARprecision=VARprecision)
setParameterByName_3 = Element.SetParameterByName(element=scopeIf_4, parameterName=VARYParameter, value=roundToPrecision_3)
VARPointReferenceParameter = Input(VARPointReferenceParameter: string)
parameterExists_4 = Custom[CW.Element.ParameterExists](VARparam=VARPointReferenceParameter, VARelement=turnIntoList)
scopeIf_5 = Custom[CW.ScopeIf+](VARtest=parameterExists_4, VARtrue=byPoint, VARfalse=empty_2)
watch = Watch(code_block_4.out1)
setParameterByName_4 = Element.SetParameterByName(element=scopeIf_5, parameterName=VARPointReferenceParameter, value=watch)
VARTimeParameter = Input(VARTimeParameter: string)
parameterExists_5 = Custom[CW.Element.ParameterExists](VARparam=VARTimeParameter, VARelement=turnIntoList)
scopeIf_6 = Custom[CW.ScopeIf+](VARtest=parameterExists_5, VARtrue=byPoint, VARfalse=empty_2)
now = DateTime.Now()
string_from_object = FromObject(obj=now)
setParameterByName_5 = Element.SetParameterByName(element=scopeIf_6, parameterName=VARTimeParameter, value=string_from_object)
VARDocumentParameter = Input(VARDocumentParameter: string)
parameterExists_6 = Custom[CW.Element.ParameterExists](VARparam=VARDocumentParameter, VARelement=turnIntoList)
scopeIf_7 = Custom[CW.ScopeIf+](VARtest=parameterExists_6, VARtrue=byPoint, VARfalse=empty_2)
al_current_document_2 = Custom[AL.Current Document]()
get_document_name = Custom[Get Document Name](VARDocument=al_current_document_2)  # Get Document Name
setParameterByName_6 = Element.SetParameterByName(element=scopeIf_7, parameterName=VARDocumentParameter, value=get_document_name.VARName, lacing=Longest)
parameterExists_7 = Custom[CW.Element.ParameterExists](VARparam=VARFamilyInfoParameterName, VARelement=turnIntoList)
scopeIf_8 = Custom[CW.ScopeIf+](VARtest=parameterExists_7, VARtrue=byPoint, VARfalse=empty_2)
get_family_and_type_name_by = Custom[Get Family and Type Name By Family Instance](VARFamilyInstance=location_of_any_element.VARElements)  # Get Family and Type Name
code_block_5 = CodeBlock { ":"; }
code_block_6 = CodeBlock(a=get_family_and_type_name_by.VARFamilyName, b=code_block_5, c=get_family_and_type_name_by.VARTypeName, d=code_block_5, e=get_family_and_type_name_by.VARElementID) { a+b+c+d+e; }
matchLength = Custom[LF.List.MatchLength](VARlistLength=scopeIf_8, VARlist=code_block_6)  # Cycle a list to match the length of the first list.
setParameterByName_7 = Element.SetParameterByName(element=scopeIf_8, parameterName=VARFamilyInfoParameterName, value=matchLength)
python_script_2 = Python(IN[0]=parameterExists_6, IN[1]=parameterExists_7, IN[2]=parameterExists_4, IN[3]=parameterExists, IN[4]=parameterExists_2, IN[5]=parameterExists_3, IN[6]=parameterExists_5)
# ---------- python_script_2.python (61 lines) ----------
#This script pops up a dialog box with a message from the previous node.
import clr
clr.AddReference('RevitAPIUI')

from Autodesk.Revit.UI import TaskDialog

document = IN[0]
familyname = IN[1]
ref = IN[2]
xp = IN[3]
yp = IN[4]
zp = IN[5]
date = IN[6]


if document[0] == False:
	document = "Document Parameter - Text Type\n"
else:
	document = ""

if familyname[0] == False:
	familyname = "Family Info Parameter - Text Type\n"
else:
	familyname = ""

if ref[0] == False:
	ref = "Point Reference Parameter - Text Type\n"
else:
	ref = ""

if xp[0] == False:
	xp = "X Parameter - Number Type\n"
else:
	xp = ""

if yp[0] == False:
	yp = "Y Parameter - Number Type\n"
else:
	yp = ""
	
if zp[0] == False:
	zp = "Z Parameter - Number Type\n"
else:
	zp = ""

if date[0] == False:
	date = "Time Parameter - Text Type\n"
else:
	date = ""


all = "Please Add The Following Parameters To Coordination Family\n\n" + document + familyname + ref + xp + yp + zp + date 

if document == "" and familyname =="" and ref == "" and xp == "" and yp == "" and zp == "" and date == "":
	pass
else:
	messagePop = TaskDialog("Synthesize toolkit")
	messagePop.MainContent = all
	messagePop.Show()

OUT = "Success!"
# ----------------------------------------
VARFamilyInstance = Output(byPoint)
