# Dynamo custom node Copy Element Overrides.dyf (Dynamo 2.1.0.7500)
# category: Synthesize.Automate.Family
# Copy Element Overrides

VARViews = Input(VARViews: var[]..[])
VARElements = Input(VARElements: var[]..[])
python_script = Python(IN[0]=VARViews, IN[1]=VARElements)
# ---------- python_script.python (85 lines) ----------
# Created By Karam Baki : karam@aecedx.com
# Enable Python support and load DesignScript library
# IMPORTANT : ALL DYNAMO DESIGN SCRIPT NODES ARE AS (dg)
import clr
import math
clr.AddReference('ProtoGeometry')
from Autodesk.DesignScript import Geometry as dg

# EXTENSION Enable ToDSType
clr.AddReference('RevitNodes')
import Revit
clr.ImportExtensions(Revit.Elements)

# Enable Revit Elements
from Revit.Elements import *

# EXTENSION Enable Geometry Conversion Methods
clr.ImportExtensions(Revit.GeometryConversion)

# Enable Revit API
clr.AddReference('RevitAPI')
from Autodesk.Revit.DB import *

# Enable DocumentManager and TransactionManager
clr.AddReference('RevitServices')
from RevitServices.Persistence import DocumentManager
from RevitServices.Transactions import TransactionManager

# Enable ICollection List Translate
clr.AddReference("System")
import System.Collections.Generic
from System.Collections.Generic import List
from itertools import compress
#The inputs to this node will be stored as a list in the IN variables.

doc = DocumentManager.Instance.CurrentDBDocument
uidoc = DocumentManager.Instance.CurrentUIApplication.ActiveUIDocument
uiapp = DocumentManager.Instance.CurrentUIApplication
app = uiapp.Application

def flatten(x):
    result = []
    for el in x:
        if hasattr(el, "__iter__") and not isinstance(el, basestring):
            result.extend(flatten(el))
        else:
            result.append(el)
    return result

allviews = UnwrapElement(IN[0])
elems = UnwrapElement(IN[1])

active = uidoc.ActiveView

graphsettings = []
TransactionManager.Instance.EnsureInTransaction(doc)

idsofelems = []
for each in elems:
	idsofelems.append(each.Id)


bool_list = []
for each in idsofelems:
	try:
		graphsettings.append(active.GetElementOverrides(each))
		bool_list.append(True)
	except:
		bool_list.append(False)	

filteredelemens = list(compress(idsofelems, bool_list))

count = 0
for v in allviews:
	countin = 0
	for e in filteredelemens:
		try:
			v.SetElementOverrides(e, graphsettings[countin])
			countin = countin + 1
		except:
			countin = countin + 1
	count + 1
TransactionManager.Instance.TransactionTaskDone()

OUT = "DONE"
# ----------------------------------------
VAROutput = Output(python_script)
