# Dynamo custom node CopyElementsFromLinksByCategory.dyf (Dynamo 2.13.1.3887)
# category: Synthesize.Automate.Links
# CopyElementsFromLinksByCategory
# packages: Synthesize toolkit 12.5.1

VARLinkNamestoCopyFromSeparateByComma = Input(VARLinkNamestoCopyFromSeparateByComma: string)
VARCategorytoCopy = Input(VARCategorytoCopy: Revit.Elements.Category = Revit.Elements.Category.ByName("OST_Walls"))
VARFilterParameterName = Input(VARFilterParameterName: string = "")
VARFilterParameterValue = Input(VARFilterParameterValue: string = "")
VARCustomResultGroupSuffix = Input(VARCustomResultGroupSuffix: string = "")
VARGenerateModelGroup = Input(VARGenerateModelGroup: bool = true)
VARGenerateVoidFamily = Input(VARGenerateVoidFamily: bool = true)
VARFamilyTemplatePath = Input(VARFamilyTemplatePath: string = null)
isNull = Object.IsNull(object=VARFamilyTemplatePath)
default_family_template = StringInput("C:\ProgramData\Autodesk\RVT 2023\Family Templates\English\Metric Generic Model.rft")
scopeIf = Custom[CW.ScopeIf+](VARtest=isNull, VARtrue=default_family_template, VARfalse=VARFamilyTemplatePath)  # package Synthesize toolkit; A (hopefully) more robust implementation of ScopeIf. Tests a single boolean and returns a value accordingly.
VARFamilyCategory = Input(VARFamilyCategory: var = Revit.Elements.Category.ByName("OST_GenericModel"))
smart_rft_path = Custom[Smart RFT Path](VARRFTFile=scopeIf, VARCategory=VARFamilyCategory)  # package Synthesize toolkit; Smart RFT Path
python_script = Python(IN[0]=VARLinkNamestoCopyFromSeparateByComma, IN[1]=VARCategorytoCopy, IN[2]=VARFilterParameterName, IN[3]=VARFilterParameterValue, IN[4]=VARCustomResultGroupSuffix, IN[5]=VARGenerateModelGroup, IN[6]=VARGenerateVoidFamily, IN[7]=smart_rft_path, IN[8]=VARFamilyCategory)  # IronPython2
# ---------- python_script.python (428 lines) ----------
# Created By Karam Baki : karam@aecedx.com
import clr

# EXTENSION Enable ToDSType
clr.AddReference('RevitNodes')
import Revit

# Enable Revit API
clr.AddReference('RevitAPI')
from Autodesk.Revit.DB import *

# Enable DocumentManager and TransactionManager
clr.AddReference('RevitServices')
from RevitServices.Persistence import DocumentManager
from RevitServices.Transactions import TransactionManager

# Enable ICollection List Translate
import System
clr.AddReference("System")
import System.Collections.Generic
from System.Collections.Generic import List

clr.AddReference("RevitAPIUI")
from Autodesk.Revit.UI import TaskDialog

class KaramWarningIgnore(IFailuresPreprocessor):
	def PreprocessFailures(self, failuresAccessor):
		failuresAccessor.DeleteAllWarnings()
		return FailureProcessingResult.Continue

class FamOpt1(IFamilyLoadOptions):
	def __init__(self):
		pass
	def OnFamilyFound(self,familyInUse, overwriteParameterValues):
		overwriteParameterValues.Value = True
		return True
	def OnSharedFamilyFound(self,familyInUse, source, overwriteParameterValues):
		overwriteParameterValues.Value = True
		return True

class DuplicateHandler(IDuplicateTypeNamesHandler):
	def OnDuplicateTypeNamesFound(self, args):
		return DuplicateTypeAction.UseDestinationTypes

def flatten(x):
    result = []
    for el in x:
        if hasattr(el, "__iter__") and not isinstance(el, basestring):
            result.extend(flatten(el))
        else:
            result.append(el)
    return result

def StringParamGet(element,param):
	param = element.LookupParameter(param)
	if param != None:
		if param.StorageType == StorageType.String:
			if param.HasValue:
				return param.AsString()
			else:
				return ""
		elif param.StorageType == StorageType.Integer:
			if param.HasValue:
				return param.AsInteger().ToString()
			else:
				return ""
		else:
			return ""
	else:
		return ""

def transferunit(doc,famdoc):
	if int(DocumentManager.Instance.CurrentUIApplication.Application.VersionNumber) < 2021:
		unit = famdoc.GetUnits()
		currectformat = doc.GetUnits().GetFormatOptions(UnitType.UT_Length)
		accuracy = currectformat.Accuracy
		unit.SetFormatOptions(UnitType.UT_Length,FormatOptions(currectformat.DisplayUnits,accuracy))
		famdoc.SetUnits(unit)
	else:
		unit = famdoc.GetUnits()
		currectformat = doc.GetUnits().GetFormatOptions(SpecTypeId.Length)
		unit.SetFormatOptions(SpecTypeId.Length,currectformat)
		famdoc.SetUnits(unit)

def getfamtype(famdoc,famtypename = None):
	alltypes = famdoc.FamilyManager.Types
	if len(list(alltypes)) == 1 or famtypename == None:
		famtype = famdoc.FamilyManager.CurrentType
	elif len(list(alltypes)) == 0 or famtypename == None:
		famtype = famdoc.FamilyManager.NewType(famtypename)
		famdoc.FamilyManager.CurrentType = famtype
	else:
		for t in alltypes:
			if t.Name == famtypename:
				famdoc.FamilyManager.CurrentType = t
				famtype = t
				break
	return famtype

def createfamily(fam_path,doc,famname,famcategory,isShared = False,isWorkplane = False,isVertical = False,isCuts = True):
	save_path = '%s%s.rfa' % (temp_path, famname)
	famdoc = doc.Application.NewFamilyDocument(fam_path)
	try:
		TransactionManager.Instance.ForceCloseTransaction()
		trans1 = Transaction(famdoc, 'New ' + famname + ' Family')
		trans1.Start()
		warnhandle = KaramWarningIgnore()
		foptions = trans1.GetFailureHandlingOptions()
		foptions.SetFailuresPreprocessor(warnhandle)
		trans1.SetFailureHandlingOptions(foptions)
		transferunit(doc,famdoc)
		try:
			fam_cat = famdoc.Settings.Categories.get_Item(famcategory)
			famdoc.OwnerFamily.FamilyCategory = fam_cat
		except:
			pass
		getfamtype(famdoc)
		if isShared == True:
			try:famdoc.OwnerFamily.get_Parameter(BuiltInParameter.FAMILY_SHARED).Set(1)
			except:pass
		else:
			try:famdoc.OwnerFamily.get_Parameter(BuiltInParameter.FAMILY_SHARED).Set(0)
			except:pass
		if isWorkplane == True:
			try:famdoc.OwnerFamily.get_Parameter(BuiltInParameter.FAMILY_WORK_PLANE_BASED).Set(1)
			except:pass
		else:
			try:famdoc.OwnerFamily.get_Parameter(BuiltInParameter.FAMILY_WORK_PLANE_BASED).Set(0)
			except:pass
		if isVertical == True:
			try:famdoc.OwnerFamily.get_Parameter(BuiltInParameter.FAMILY_ALWAYS_VERTICAL).Set(1)
			except:pass
		else:
			try:famdoc.OwnerFamily.get_Parameter(BuiltInParameter.FAMILY_ALWAYS_VERTICAL).Set(0)
			except:pass
		if isCuts == True:
			try:famdoc.OwnerFamily.get_Parameter(BuiltInParameter.FAMILY_ALLOW_CUT_WITH_VOIDS).Set(1)
			except:pass
		else:
			try:famdoc.OwnerFamily.get_Parameter(BuiltInParameter.FAMILY_ALLOW_CUT_WITH_VOIDS).Set(0)
			except:pass
		trans1.Commit()
		famdoc.SaveAs(save_path, SaveAsOpt)
		loaded = famdoc
	except:
		try:
			trans1.Commit()
		except:
			pass
		TransactionManager.Instance.ForceCloseTransaction()
		try:famdoc.Close(False)
		except:pass
		try:System.IO.File.Delete(save_path)
		except:pass
		loaded = None
	return loaded,save_path

def groupDuplicateHandle(expectedGroupName,groupgen):
	if groupgen == False:
		return False
	existedGroups = FilteredElementCollector(doc).OfCategory(BuiltInCategory.OST_IOSModelGroups).WhereElementIsNotElementType().ToElements()
	for existedGroup in existedGroups:
		if existedGroup.Name == expectedGroupName:
			doc.Delete(existedGroup.Id)
	toDeleteGroupTypeIds = []
	existedGroupTypes = FilteredElementCollector(doc).OfCategory(BuiltInCategory.OST_IOSModelGroups).WhereElementIsElementType().ToElements()
	for existedGroupType in existedGroupTypes:
		if existedGroupType.get_Parameter(BuiltInParameter.ALL_MODEL_TYPE_NAME).AsString() == expectedGroupName:
			toDeleteGroupTypeIds.append(existedGroupType.Id)
	for toDeleteGroupTypeId in toDeleteGroupTypeIds:
		doc.Delete(toDeleteGroupTypeId)
	if len(toDeleteGroupTypeIds) == 0:
		return False
	else:
		return True

doc = DocumentManager.Instance.CurrentDBDocument
uiapp = DocumentManager.Instance.CurrentUIApplication

linksIds = FilteredElementCollector(doc).OfClass(RevitLinkInstance).ToElementIds()
links = []
for linkId in linksIds:
	links.append(doc.GetElement(linkId))

linksData = []
for link in links:
	linkDoc = link.GetLinkDocument()
	if linkDoc != None:
		linkTitle = linkDoc.Title + ".rvt"
	else:
		continue
	linksData.append([link, linkDoc, linkTitle, link.GetTotalTransform()])
	
cleanedLinksData = []
for linkData in linksData:
	if linkData[1] != None:
		cleanedLinksData.append(linkData)
linksData = cleanedLinksData

Dialogtitle = "AECedx - Karam"
linkNames = IN[0].split(",")
category = UnwrapElement(IN[1])
filterName = IN[2]
filterValue = IN[3]
customSuffix = IN[4]
groupgen = IN[5]
famgen = IN[6]
fam_path = IN[7]
famcategory = UnwrapElement(IN[8])

try:
	famcategory = famcategory.Name
except:
	pass

temp_path = System.IO.Path.GetTempPath()

SaveAsOpt = SaveAsOptions()
SaveAsOpt.OverwriteExistingFile = True
opt1 = Options()
copyOptions = CopyPasteOptions()
copyOptions.SetDuplicateTypeNamesHandler(DuplicateHandler())

acceptedData = []
for Data in linksData:
	for linkName in linkNames:
		if linkName.lower() == Data[2].lower():
			acceptedData.append(Data)
			break

if len(acceptedData) == 0:
	TaskDialog.Show(Dialogtitle, "Link Not Found. No Action Made.")
elif groupgen == False and famgen == False:
	TaskDialog.Show(Dialogtitle, "No Group or Void Family Requested. No Action Made.")
else:
	existedElements = FilteredElementCollector(doc).WhereElementIsNotElementType().ToElementIds()
	
	transGroup = TransactionGroup(doc)
	if groupgen and famgen:
		transGroup.Start("Dynamo Create Group and Load Void Family")
	elif groupgen:
		transGroup.Start("Dynamo Create Group")
	elif famgen:
		transGroup.Start("Dynamo Load Void Family")
	TransactionManager.Instance.ForceCloseTransaction()
	trans = Transaction(doc, 'Dynamo Copy Linked Elements')
	trans.Start()
	warnhandle = KaramWarningIgnore()
	foptions = trans.GetFailureHandlingOptions()
	foptions.SetFailuresPreprocessor(warnhandle)
	trans.SetFailureHandlingOptions(foptions)
	subtranGroup = SubTransaction(doc)
	subtranGroup.Start()
	megaData = []
	copied = []
	failedtoCopyMega = "All Elements Successfully Copied"
	group = None
	for accData in acceptedData:
		if customSuffix == "":
			if filterName == "":
				expectedGroupName = "Link_" + category.Name + "_" + accData[1].Title
			else:
				expectedGroupName = "Link_" + category.Name + "_" + accData[1].Title + "_" + filterName + "_" + filterValue
		else:
			if filterName == "":
				expectedGroupName = "Link_" + category.Name + "_" + accData[1].Title + "_" + customSuffix
			else:
				expectedGroupName = "Link_" + category.Name + "_" + accData[1].Title + "_" + filterName + "_" + filterValue + "_" + customSuffix
		elems = []
		ids = []
		rawids = (FilteredElementCollector(accData[1]).OfCategoryId(category.Id).WhereElementIsNotElementType().ToElementIds())
		if filterName != "" and filterValue != "":
			for rawid in rawids:
				if StringParamGet(accData[1].GetElement(rawid),filterName).lower() == filterValue.lower():
					ids.append(rawid)
			ids = List[ElementId](ids)
		else:
			ids = rawids
		try:
			IsUpdate = groupDuplicateHandle(expectedGroupName,groupgen)
			if len(ids) > 0:
				copied = list(ElementTransformUtils.CopyElements(accData[1], ids, doc, accData[3], copyOptions))
				copied = List[ElementId](copied)
			else:
				copied = List[ElementId]()
		except:
			subtranGroup.RollBack()
			subtranGroup.Start()
			copied = []
			IsUpdate = groupDuplicateHandle(expectedGroupName,groupgen)
			failedtoCopy = []
			for id in ids:
				ilistofids = List[ElementId]()
				ilistofids.Add(id)
				try:
					copied.append(ElementTransformUtils.CopyElements(accData[1], ilistofids, doc, accData[3], copyOptions))
				except:
					if not hasattr(failedtoCopyMega, 'append'):
						failedtoCopyMega = []
					if len(failedtoCopy) == 0:
						failedtoCopy.append("Failed to Copy The following Elements From Link " + accData[2])
					failedtoCopy.append(id.ToString())
			if len(failedtoCopy) != 0:
				failedtoCopyMega.append("\n".join(failedtoCopy))
			copied = flatten(copied)
			copied = List[ElementId](copied)
		subtranGroup.Commit()
		newElements = List[ElementId](list(set(FilteredElementCollector(doc).WhereElementIsNotElementType().ToElementIds())-set(existedElements)))
		subtranGroup.Start()
		if len(newElements) > 0:
			try:
				group = doc.Create.NewGroup(newElements)
				group.GroupType.Name = expectedGroupName
				group.Pinned = True
				subtranGroup.Commit()
			except:
				subtranGroup.RollBack()
				subtranGroup.Start()
				group = doc.Create.NewGroup(copied)
				group.GroupType.Name = expectedGroupName
				group.Pinned = True
				subtranGroup.Commit()
		megaData.append([expectedGroupName,newElements])
	
	if len(copied) == 0 or len(newElements) == 0:
		trans.RollBack()
		TaskDialog.Show(Dialogtitle, "No Elements Copied. No Action Made.")
	else:
		trans.Commit()
		if famgen == False:
			if IsUpdate:
				TaskDialog.Show(Dialogtitle, "Successfully Updated Group (Deleted Old)\n" + expectedGroupName)
			else:
				TaskDialog.Show(Dialogtitle, "Successfully Created Group\n" + expectedGroupName)
	
	if famgen and len(newElements) > 0:
		for mega in megaData:
			famname = mega[0]
			newElements =  mega[1]
			extracted = []
			for newElement in newElements:
				elem = doc.GetElement(newElement)
				if elem != None:
					geoms = elem.get_Geometry(opt1)
					if geoms != None:
						for e in geoms:
							try:
								if e.ToString() == "Autodesk.Revit.DB.GeometryInstance":
									try:
										extracted.append(e.GetInstanceGeometry())
									except:
										pass
								elif e.ToString() == "Autodesk.Revit.DB.Solid":
									extracted.append(e)
							except:
								continue
			extracted = flatten(extracted)
			if len(extracted) > 0:
				familyData = createfamily(fam_path,doc,famname,famcategory)
				famdoc = familyData[0]
				save_path = familyData[1]
				TransactionManager.Instance.ForceCloseTransaction()
				trans1 = Transaction(famdoc, 'Dynamo Creating FreeForms ' + famname)
				trans1.Start()
				warnhandle = KaramWarningIgnore()
				foptions = trans1.GetFailureHandlingOptions()
				foptions.SetFailuresPreprocessor(warnhandle)
				trans1.SetFailureHandlingOptions(foptions)
				for e in extracted:
					try:
						freeform = FreeFormElement.Create(famdoc,e)
						freeform.get_Parameter(BuiltInParameter.ELEMENT_IS_CUTTING).Set(1)
					except:
						continue
				trans1.Commit()
				loaded = famdoc.LoadFamily(doc,FamOpt1())
				symbols = loaded.GetFamilySymbolIds().GetEnumerator()
				symbols.MoveNext()
				symbol1 = doc.GetElement(symbols.Current)
				TransactionManager.Instance.ForceCloseTransaction()
				trans1 = Transaction(doc, 'Dynamo Placing Family ' + famname)
				trans1.Start()
				warnhandle = KaramWarningIgnore()
				foptions = trans1.GetFailureHandlingOptions()
				foptions.SetFailuresPreprocessor(warnhandle)
				trans1.SetFailureHandlingOptions(foptions)
				if not symbol1.IsActive: symbol1.Activate()
				existedelems = [x for x in FilteredElementCollector(doc).OfClass(FamilyInstance).ToElements() if loaded.Name == x.Symbol.FamilyName]
				if len(existedelems) == 0:
					newinstance = doc.Create.NewFamilyInstance(XYZ.Zero, symbol1, Structure.StructuralType.NonStructural)
					newinstance.Pinned = True
				else:
					newinstance = existedelems
					if len(newinstance) == 1:
						newinstance = newinstance[0]
				trans1.Commit()
				TransactionManager.Instance.ForceCloseTransaction()
				famdoc.Close(False)
				System.IO.File.Delete(save_path)
	
	if groupgen == False:
		TransactionManager.Instance.ForceCloseTransaction()
		trans1 = Transaction(doc, 'Dynamo Delete Generated Group')
		trans1.Start()
		warnhandle = KaramWarningIgnore()
		foptions = trans1.GetFailureHandlingOptions()
		foptions.SetFailuresPreprocessor(warnhandle)
		trans1.SetFailureHandlingOptions(foptions)
		typetoDelete = group.GetTypeId()
		doc.Delete(group.Id)
		doc.Delete(typetoDelete)
		group = "No Model Group Requested"
		trans1.Commit()
	transGroup.Assimilate()
	if famgen:
		if IsUpdate:
			if groupgen == False:
				TaskDialog.Show(Dialogtitle, "Successfully Reloaded Family\n" + expectedGroupName)
			else:
				TaskDialog.Show(Dialogtitle, "Successfully Updated Group (Deleted Old) And Reloaded Family\n" + expectedGroupName)
		else:
			if groupgen == False:
				TaskDialog.Show(Dialogtitle, "Successfully Loaded Family\n" + expectedGroupName)
			else:
				TaskDialog.Show(Dialogtitle, "Successfully Created Group And Loaded Family\n" + expectedGroupName)
		OUT = group,newinstance,failedtoCopyMega
	else:
		OUT =  group,"No Void Family Requested",failedtoCopyMega
# ----------------------------------------
VAROutput = Output(python_script)
