# Dynamo custom node Create 3D or Select It.dyf (Dynamo 2.1.0.7500)
# category: Synthesize.Automate.Views
# Create 3D or Select It

VARName = Input(VARName: string = "ThreeD")
VARJustGenerate = Input(VARJustGenerate: bool = false)
VARGoToggle = Input(VARGoToggle: bool = true)
python_script = Python(IN[0]=VARName, IN[1]=VARJustGenerate, IN[2]=VARGoToggle)
# ---------- python_script.python (61 lines) ----------
#Created By Karam Baki : karam@aecedx.com

import clr
clr.AddReference('ProtoGeometry')
from Autodesk.DesignScript.Geometry import *

# Import DocumentManager and TransactionManager
clr.AddReference("RevitServices")
import RevitServices
from RevitServices.Persistence import DocumentManager
from RevitServices.Transactions import TransactionManager

# Import RevitAPI
clr.AddReference("RevitAPI")
import Autodesk
from Autodesk.Revit.DB import *

from System.Collections.Generic import *

clr.AddReference("RevitNodes")
import Revit
clr.ImportExtensions(Revit.Elements)

dataEnteringNode = IN

doc = DocumentManager.Instance.CurrentDBDocument
uiapp = DocumentManager.Instance.CurrentUIApplication
app = uiapp.Application

collector = FilteredElementCollector(doc)
views = collector.OfClass(View).ToElements()

threedename = IN[0]
justgenerate = IN[1]
go = IN[2]

result = []

if go == True:
	views = collector.OfClass(View).ToElements()
	for v in views:
		if v.ViewType == ViewType.ThreeD and v.Name == threedename:
			result = v
			break
	if result == []:
		collector = FilteredElementCollector(doc);
		viewFamilyType = collector.OfClass(ViewFamilyType);
		wantedtype = []
		for e in viewFamilyType:
			if e.ViewFamily == ViewFamily.ThreeDimensional:
				wantedtype = e
				break
		TransactionManager.Instance.EnsureInTransaction(doc)
		result = View3D.CreateIsometric(doc,wantedtype.Id)
		if justgenerate == False:
			result.Name = threedename
		TransactionManager.Instance.TransactionTaskDone()
else:
	result = "Go Not True"
#Assign your output to the OUT variable
OUT = result
# ----------------------------------------
VARView = Output(python_script)
