# Dynamo custom node Create Floors By Boundary Lines (Smart).dyf (Dynamo 2.1.0.7500)
# category: Synthesize.Automate.Floors
# Create Floors By Boundary Lines (Smart)

VARFloorsBoundariesPolycurves = Input(VARFloorsBoundariesPolycurves: var[]..[])
turnIntoList = Custom[CW.TurnIntoList](VARunknownItem=VARFloorsBoundariesPolycurves)  # Turns an element (or a nested list) into a flat list
code_block = CodeBlock { false; }
clean = List.Clean(list=turnIntoList, preserveIndices=code_block)
closeWithLine = PolyCurve.CloseWithLine(polyCurve=clean)
curves = PolyCurve.Curves(polyCurve=closeWithLine)
VAROffset = Input(VAROffset: var[]..[])
curves_offset_to_revit = Custom[Curves Offset To Revit Compatibility](VARCurves=curves, VAROffset=VAROffset)  # Curves Offset To Revit Compatibility
byJoinedCurves = PolyCurve.ByJoinedCurves(curves=curves_offset_to_revit.VARCurves)
VARFloorType = Input(VARFloorType: var[]..[])
code_block_2 = CodeBlock { false; 0.001; 0; }
VARFixFactorDependsofProjectUnits1Formet = Input(VARFixFactorDependsofProjectUnits1Formetersforexampleand100forCentimeters: var[]..[])
VARUseAllLevelsIgnoresLevelsSelectionFil = Input(VARUseAllLevelsIgnoresLevelsSelectionFilter: var[]..[])
element_types = ElementTypes("Level")
all_elements_of_type = ElementsOfType(element_type=element_types)
hot_get_all_filter = Custom[HOT.Get All Filter]()  # Get all Filter
VARLevelsSelectionFiltertoRead = Input(VARLevelsSelectionFiltertoRead: var[]..[])
eq = hot_get_all_filter.VARName == VARLevelsSelectionFiltertoRead
filterByBoolMask = List.FilterByBoolMask(list=hot_get_all_filter.VARElement, mask=eq)
elements = Custom[CW.SelectionSet.Elements](VARselectionSet=filterByBoolMask.in)  # Retrieves all elements stored in a selection set
flatten = List.Flatten(list=elements)
scopeIf = Custom[CW.ScopeIf+](VARtest=VARUseAllLevelsIgnoresLevelsSelectionFil, VARtrue=all_elements_of_type, VARfalse=flatten)  # A (hopefully) more robust implementation of ScopeIf. Tests a single boolean and returns a value accordingly.
flatten_2 = List.Flatten(list=scopeIf)
startPoint = Curve.StartPoint(curve=closeWithLine)
detect_levels_of_points = Custom[Detect Levels of Points](VARSetOffsetParameter=code_block_2.out0, VARRoundingValue=code_block_2.out1, VARRoundingFix=code_block_2.out0, VARFixFactorDependsofProjectUnits1Formetersforexampleand100forCentimeters=VARFixFactorDependsofProjectUnits1Formet, VARLevels=flatten_2, VARPoints=startPoint, VARZLocationOffset=code_block_2.out2)  # Family Refine Levels and Offset
flatten_3 = List.Flatten(list=detect_levels_of_points.VARLevelsSet)
byOutlineTypeAndLevel = Floor.ByOutlineTypeAndLevel(outlineCurves=byJoinedCurves, floorType=VARFloorType, level=flatten_3, lacing=Longest)
count = List.Count(list=byOutlineTypeAndLevel)
VARNumberofFloorsCreated = Output(count)
VARFloors = Output(byOutlineTypeAndLevel)
