# Dynamo custom node Create Material If Not Existed.dyf (Dynamo 2.1.0.7500)
# category: Synthesize.Automate.Material
# Create Material If Not Existed

VARMaterialName = Input(VARMaterialName: var[]..[])
VARMaterialColorToUseIfNotExisted = Input(VARMaterialColorToUseIfNotExisted: var[]..[])
VARMaterialTransparancyToUseIfNotExisted = Input(VARMaterialTransparancyToUseIfNotExisted: var[]..[])
python_script = Python(IN[0]=VARMaterialName, IN[1]=VARMaterialColorToUseIfNotExisted, IN[2]=VARMaterialTransparancyToUseIfNotExisted)
# ---------- python_script.python (72 lines) ----------
# Enable Python support and load DesignScript library
# IMPORTANT : ALL DYNAMO DESIGN SCRIPT NODES ARE AS (dg)
import clr
clr.AddReference('ProtoGeometry')
from Autodesk.DesignScript import Geometry as dg

# EXTENSION Enable ToDSType
clr.AddReference('RevitNodes')
import Revit
clr.ImportExtensions(Revit.Elements)

# Enable Revit Elements
from Revit.Elements import *

# EXTENSION Enable Geometry Conversion Methods
clr.ImportExtensions(Revit.GeometryConversion)

# Enable Revit API
clr.AddReference('RevitAPI')
from Autodesk.Revit.DB import *

# Enable DocumentManager and TransactionManager
clr.AddReference('RevitServices')
from RevitServices.Persistence import DocumentManager
from RevitServices.Transactions import TransactionManager

# Enable ICollection List Translate
clr.AddReference("System")
import System.Collections.Generic
from System.Collections.Generic import List

dataEnteringNode = IN
# Use UnwrapElement(IN[0]) When Translating From Dynamo to Revit
mat=UnwrapElement(IN[0])
dynamocolor=UnwrapElement(IN[1])
transparancy = IN[2]

revitcolor = Color(dynamocolor.Red,dynamocolor.Green,dynamocolor.Blue)

# Choose The Current Document
doc = DocumentManager.Instance.CurrentDBDocument
uidoc = DocumentManager.Instance.CurrentUIApplication.ActiveUIDocument
uiapp = DocumentManager.Instance.CurrentUIApplication
app = uiapp.Application

# Create Empty List
result = []

# Start a Transaction with Current Document (doc)
TransactionManager.Instance.EnsureInTransaction(doc)

matname = mat
mat_fec = FilteredElementCollector(doc).OfClass(Material)
fam_mat = False
for m in mat_fec:
	if m.Name.lower() == mat.lower():
		fam_mat = m
		break
if fam_mat == False:
	newmat = Material.Create(doc, mat)
	fam_mat = doc.GetElement(newmat)
	fam_mat.Color = revitcolor
	fam_mat.Transparency = transparancy
	
result = fam_mat
name = fam_mat.Name
# End the Transaction with Current Document ()
TransactionManager.Instance.TransactionTaskDone()


# Assign your output to the OUT variable.
OUT = result,name
# ----------------------------------------
code_block = CodeBlock(a=python_script) { a[0]; a[1]; }
VARMaterial = Output(code_block.out0)
VARName = Output(code_block.out1)
