# Dynamo custom node Create Pads By Level and Curves Loops.dyf (Dynamo 2.1.0.7500)
# category: Synthesize.Automate.Topography
# Create Pads By Level and Curves Loops

VARLevels = Input(VARLevels: var[]..[])
firstItem = List.FirstItem(list=VARLevels)
VARPadType = Input(VARPadType: var[]..[])
firstItem_2 = List.FirstItem(list=VARPadType)
VARCurves = Input(VARCurves: var[]..[])
python_script = Python(IN[0]=firstItem, IN[1]=firstItem_2, IN[2]=VARCurves)
# ---------- python_script.python (52 lines) ----------
import clr
#Import Revit Services
clr.AddReference ("RevitServices")
import RevitServices
from RevitServices.Persistence import DocumentManager
from RevitServices.Transactions import TransactionManager
#Import Revit API
clr.AddReference('RevitAPI')
from Autodesk.Revit.DB import *
from Autodesk.Revit.DB.Architecture import *
clr.AddReference('RevitAPIUI')
from Autodesk.Revit.UI import *
#Import Revit Node
clr.AddReference('RevitNodes')
import Revit
clr.ImportExtensions(Revit.GeometryConversion)
clr.ImportExtensions(Revit.Elements)
#Import Proto Geometry
clr.AddReference('ProtoGeometry')
from Autodesk.DesignScript.Geometry import *

import System
from System.Collections.Generic import *

#inputs
level = UnwrapElement(IN[0])
padType = UnwrapElement(IN[1])
curves = IN[2]

#necessary ID's
levelId = level.Id
typeId = padType.Id

#creating CurveLoop
loop = CurveLoop()
for c in curves:
	loop.Append(c.ToRevitType())

#get the document
doc = DocumentManager.Instance.CurrentDBDocument

#use safe transaction with Revit
TransactionManager.Instance.EnsureInTransaction(doc)

#creating pad
loop
pad = BuildingPad.Create(doc,typeId,levelId,[loop])

#Finish transaction with task done
TransactionManager.Instance.TransactionTaskDone()

OUT = pad
# ----------------------------------------
VARPads = Output(python_script)
