# Dynamo custom node Curve.ExtrudeAsSolid Fixer.dyf (Dynamo 2.1.0.7500)
# category: Synthesize.Fixers
# Curve.ExtrudeAsSolid Fixer

VARcurve = Input(VARcurve: Autodesk.DesignScript.Geometry.Curve)
VARdirection = Input(VARdirection: Autodesk.DesignScript.Geometry.Vector)
VARdistance = Input(VARdistance: double)
extrudeAsSolid = Curve.ExtrudeAsSolid(curve=VARcurve, direction=VARdirection, distance=VARdistance)
VARSolid = Output(extrudeAsSolid)
