# Dynamo custom node Curve.Offset Fixer.dyf (Dynamo 2.1.0.7500)
# category: Synthesize.Fixers
# Curve.Offset Fixer

VARcurve = Input(VARcurve: Autodesk.DesignScript.Geometry.Curve)
VARdistance = Input(VARdistance: double)
offset = Curve.Offset(curve=VARcurve, distance=VARdistance)
VARCurve = Output(offset)
