# Dynamo custom node CurveByPoints.ByReferencePoints Fixer.dyf (Dynamo 2.1.0.7500)
# category: Synthesize.Fixers
# CurveByPoints.ByReferencePoints Fixer

VARpoints = Input(VARpoints: var[]..[])
VARisReferenceLine = Input(VARisReferenceLine: var[]..[])
byReferencePoints = CurveByPoints.ByReferencePoints(points=VARpoints, isReferenceLine=VARisReferenceLine)
VARCurveByPoints = Output(byReferencePoints)
