# Dynamo custom node CurveLoop.Simplify.ByAngle.dyf (Dynamo 2.1.0.7500)
# category: Synthesize.Automate.Lines
# CurveLoop.Simplify.ByAngle

VARPolycurves = Input(VARPolycurves: var[]..[])
VARSafeAngle = Input(VARSafeAngle: double = 15)
VARFilterPolyCurvesOnly = Input(VARFilterPolyCurvesOnly: bool = false)
python_script = Python(IN[0]=VARPolycurves, IN[1]=VARSafeAngle, IN[2]=VARFilterPolyCurvesOnly)
# ---------- python_script.python (116 lines) ----------
# Enable Python support and load DesignScript library
# IMPORTANT : ALL DYNAMO DESIGN SCRIPT NODES ARE AS (dg)
import clr
clr.AddReference('ProtoGeometry')
from Autodesk.DesignScript import Geometry as dg

# EXTENSION Enable ToDSType
clr.AddReference('RevitNodes')
import Revit
clr.ImportExtensions(Revit.Elements)

# Enable Revit Elements
from Revit.Elements import *

# EXTENSION Enable Geometry Conversion Methods
clr.ImportExtensions(Revit.GeometryConversion)

# Enable Revit API
clr.AddReference('RevitAPI')
from Autodesk.Revit.DB import *

# Enable DocumentManager and TransactionManager
clr.AddReference('RevitServices')
from RevitServices.Persistence import DocumentManager
from RevitServices.Transactions import TransactionManager

# Enable ICollection List Translate
clr.AddReference("System")
import System.Collections.Generic
from System.Collections.Generic import List

def tolist(obj1):
	if hasattr(obj1,'__iter__'): return obj1
	else: return [obj1]

def flatten(x):
    result = []
    for el in x:
        if hasattr(el, "__iter__") and not isinstance(el, basestring):
            result.extend(flatten(el))
        else:
            result.append(el)
    return result

dataEnteringNode = IN
# Use UnwrapElement(IN[0]) When Translating From Dynamo to Revit
polycurve=UnwrapElement(flatten(tolist(IN[0])))
safeangle = IN[1]
polyonly = IN[2]

# Choose The Current Document
doc = DocumentManager.Instance.CurrentDBDocument
uidoc = DocumentManager.Instance.CurrentUIApplication.ActiveUIDocument
uiapp = DocumentManager.Instance.CurrentUIApplication
app = uiapp.Application

# Create Empty List
result = []

def simplifypolycurve(polycurve,safeangle):
	try:
		exploded = dg.Geometry.Explode(polycurve)
		count = 0
		totalpts = []
		curves = []
		triggerlast = False
		for exp in exploded:
			vec1 = dg.Curve.TangentAtParameter(exploded[count],0)
			vec2 = dg.Curve.TangentAtParameter(exploded[count - 1],1)
			angle = dg.Vector.AngleWithVector(vec1,vec2)
			nurbspts = exp.ToNurbsCurve().ControlPoints()
			if angle >= safeangle:
				totalpts.append(nurbspts)
			else:
				if len(totalpts) == 0:
					triggerlast = True
					storelast = nurbspts
				else:
					last_list = list(totalpts[-1])
					nurbspts = nurbspts[1:]
					for n in nurbspts:
						last_list.append(n)
					totalpts[-1] = last_list
			count += 1
		if triggerlast:
			last_list = list(totalpts[-1])
			nurbspts = storelast[1:]
			for n in nurbspts:
				last_list.append(n)
			totalpts[-1] = last_list
		
		for total in totalpts:
			curves.append(dg.NurbsCurve.ByControlPoints(total))
		joinedcurve = dg.PolyCurve.ByJoinedCurves(curves)
	except:
		if polyonly:
			if hasattr(polycurve, 'Curves'):
				joinedcurve = [polycurve]
			else:
				joinedcurve = [None]
	   	else:
	   		joinedcurve = [None]
	return joinedcurve


result = []
for poly in polycurve:
	poly = simplifypolycurve(poly,safeangle)
	if polyonly:
		if poly != None:
			result.append(poly)
	else:
		result.append(poly)

# Assign your output to the OUT variable.
OUT = result
# ----------------------------------------
VARPolycurves_2 = Output(python_script)  # "VARPolycurves"
