# Dynamo custom node Cut Elements.dyf
# category: Synthesize.Automate.Family
# Cut Elements

VARVoids = Input(VARVoids: var[]..[])
VARElements = Input(VARElements: var[]..[])
python = Python(IN[0]=VARVoids, IN[1]=VARElements)  # IronPython2
# ---------- python.python (119 lines) ----------
import clr
clr.AddReference('ProtoGeometry')
from Autodesk.DesignScript.Geometry import *

clr.AddReference("RevitAPI")
import Autodesk
from Autodesk.Revit.DB import *

clr.AddReference("RevitServices")
import RevitServices
from RevitServices.Persistence import DocumentManager
from RevitServices.Transactions import TransactionManager
from System.Collections.Generic import *

clr.AddReference("RevitNodes")
import Revit
clr.ImportExtensions(Revit.Elements)
clr.ImportExtensions(Revit.GeometryConversion)

from itertools import combinations

class WarnSwallow(IFailuresPreprocessor):
	def PreprocessFailures(self, failuresAccessor):
		fmas = failuresAccessor.GetFailureMessages()
		if len(fmas) == 0:
			self.__warn = []
			return FailureProcessingResult.Continue
		else:
			probs = []
			isgood = True
			for fma in fmas:
				sev = str(fma.GetSeverity())
				fails = list(fma.GetFailingElementIds())
				felems = []
				for f in fails:
					felems.append(doc.GetElement(f))
				if str(sev) == "Warning": 
					failuresAccessor.ResolveFailure(fma)
					failuresAccessor.DeleteWarning(fma)
				else:
					isgood = False
					probs.append(felems) 
				self.__warn = probs
		if isgood:
			return FailureProcessingResult.ProceedWithCommit
		else:
			return FailureProcessingResult.ProceedWithRollBack 

def tolist(obj1):
	if hasattr(obj1,'__iter__'): return obj1
	else: return [obj1]

def flatten(x):
    result = []
    for el in x:
        if hasattr(el, "__iter__") and not isinstance(el, basestring):
            result.extend(flatten(el))
        else:
            result.append(el)
    return result

doc = DocumentManager.Instance.CurrentDBDocument

voids = UnwrapElement(flatten(tolist(IN[0])))
elements = UnwrapElement(flatten(tolist(IN[1])))

acceptedVoids = []
voidsBBOXes = []
for void in voids:
	try:
		voidsBBOXes.append(void.get_BoundingBox(None).ToProtoType())
		acceptedVoids.append(void)
	except:
		pass
voids = acceptedVoids

acceptedElements = []
elementsBBOXes = []
for element in elements:
	try:
		elementsBBOXes.append(element.get_BoundingBox(None).ToProtoType())
		acceptedElements.append(element)
	except:
		pass
elements = acceptedElements

TransactionManager.Instance.ForceCloseTransaction()
tGroup = TransactionGroup(doc, 'Cut Elements')
tGroup.Start()

result = []
voidCount = 0
for void in voids:
	tmp = []
	voidBBox = voidsBBOXes[voidCount]
	elementsCount = 0
	for e in elements:
		elementBBox = elementsBBOXes[elementsCount]
		if BoundingBox.Intersects(voidBBox, elementBBox) and Autodesk.Revit.DB.InstanceVoidCutUtils.CanBeCutWithVoid(e):
			try:
				trans1 = Transaction(doc, 'Cut Elements Operation')
				trans1.Start()
				warnhandle = WarnSwallow()
				foptions = trans1.GetFailureHandlingOptions()
				foptions.SetFailuresPreprocessor(warnhandle)
				Autodesk.Revit.DB.InstanceVoidCutUtils.AddInstanceVoidCut(doc, e, void)
				trans1.Commit()
				tmp.append(True)
			except:
				trans1.Commit()
				tmp.append(False)
		else:
			tmp.append(False)
		elementsCount += 1
	result.append(tmp)
	voidCount += 1
tGroup.Assimilate()

OUT = result
# ----------------------------------------
VAROut = Output(python)
