# Dynamo custom node Cut Solid with Solid.dyf (Dynamo 2.1.0.7500)
# category: Synthesize.Automate.Join
# Cut Solid with Solid

VARLists = Input(VARLists: var[]..[])
python_script = Python(IN[0]=VARLists)
# ---------- python_script.python (38 lines) ----------
import clr
clr.AddReference('ProtoGeometry')
from Autodesk.DesignScript.Geometry import *

clr.AddReference("RevitAPI")
import Autodesk
from Autodesk.Revit.DB import *

clr.AddReference("RevitServices")
import RevitServices
from RevitServices.Persistence import DocumentManager
from RevitServices.Transactions import TransactionManager
from System.Collections.Generic import *

clr.AddReference("RevitNodes")
import Revit
clr.ImportExtensions(Revit.Elements)

doc = DocumentManager.Instance.CurrentDBDocument
TransactionManager.Instance.EnsureInTransaction(doc)

element = UnwrapElement(IN[0])
list = len(element)
count = 0
sublist = []

while (count < list):
	try:
		result = Autodesk.Revit.DB.SolidSolidCutUtils.AddCutBetweenSolids(doc, element[count][0], element[count][1], False)
		count
		count = count + 1
		sublist.append("Success")
	except:
		count
		count = count +1

TransactionManager.Instance.TransactionTaskDone()
OUT = sublist
# ----------------------------------------
VARResult = Output(python_script)
