# Dynamo custom node DA.DynanimatorFunction Numeric Parameter.dyf (Dynamo 2.1.0.7500)
# category: Synthesize.Packages.Dynanimator.Functions
# Helper function for Dynanimate Numeric Parameter

VARElements = Input(VARElements: var[]..[])
VARParameterName = Input(VARParameterName: var[]..[])
VARMinParamValue = Input(VARMinParamValue: var[]..[])
VARMaxParamValue = Input(VARMaxParamValue: var[]..[])
VARTotalIterations = Input(VARTotalIterations: var[]..[])
VARIteration = Input(VARIteration: var[]..[])
code_block = CodeBlock(min=VARMinParamValue, max=VARMaxParamValue, n=VARTotalIterations, iteration=VARIteration) { min + (max-min)/n*iteration; }
setParameterByName = Element.SetParameterByName(element=VARElements, parameterName=VARParameterName, value=code_block)
end = Revit.Transaction.Transaction.End(input=setParameterByName)
VARView = Input(VARView: var[]..[])
VARDirectoryPath = Input(VARDirectoryPath: var[]..[])
string = StringInput("\")  # graph input
name = Element.Name(element=VARView)
string_2 = StringInput("_")  # graph input
string_from_object = FromObject(obj=VARIteration)
string_3 = StringInput(".png")  # graph input
concat = String.Concat(string0=VARDirectoryPath, string1=string, string2=name, string3=string_2, string4=string_from_object, string5=string_3)
exportAsImage = View.ExportAsImage(view=VARView, path=concat)
end_2 = Revit.Transaction.Transaction.End(input=exportAsImage)
compose = ComposeFunctions(func0=end, func1=end_2)  # "Function.Compose"
