# Dynamo custom node DA.DynanimatorNestedFunction Numeric Parameter And Camera Position With Fixed Target.dyf (Dynamo 2.1.0.7500)
# category: Synthesize.Packages.Dynanimator.Functions
# Nested function used in DynanimatorFunction Numeric Parameter And Camera Position With Fixed Target

VARElements = Input(VARElements: var[]..[])
VARParameterName = Input(VARParameterName: var[]..[])
VARMinValue = Input(VARMinValue: var[]..[])
VARMaxValue = Input(VARMaxValue: var[]..[])
VARTotalIterations = Input(VARTotalIterations: var[]..[])
VARIteration = Input(VARIteration: var[]..[])
code_block = CodeBlock(min=VARMinValue, max=VARMaxValue, n=VARTotalIterations, iteration=VARIteration) { min + (max-min)/n*iteration; }
setParameterByName = Element.SetParameterByName(element=VARElements, parameterName=VARParameterName, value=code_block)
VARView = Input(VARView: var[]..[])
VARCameraPath = Input(VARCameraPath: var[]..[])
code_block_2 = CodeBlock(n=VARTotalIterations, iteration=VARIteration) { 1/n*iteration; }
pointAtParameter = Curve.PointAtParameter(curve=VARCameraPath, param=code_block_2)
VARTargetPosition = Input(VARTargetPosition: var[]..[])
orientToEyeAndTargetPosition = Custom[CW.PerspectiveView.OrientToEyeAndTargetPosition](VARview=VARView, VAReyePosition=pointAtParameter, VARtargetPosition=VARTargetPosition)  # Sets the orientation of a given perspective view based on a given eye and target position
create = List.Create(item0=setParameterByName, item1=orientToEyeAndTargetPosition)
VARlist = Output(create)
