# Dynamo custom node DM.Fix Point.ByCoordinates Range.dyf (Dynamo 2.1.0.7500)
# category: Synthesize.Packages.Dummy
# Dummy Node to fix the modelling range warning

VARx = Input(VARx: double)
VARy = Input(VARy: double)
VARz = Input(VARz: double)
byCoordinates = Point.ByCoordinates(x=VARx, y=VARy, z=VARz)
VARPoint = Output(byCoordinates)
