# Dynamo custom node Debug Python No Message.dyf (Dynamo 2.13.1.3887)
# category: Synthesize.Misc
# Debug Python

python_script = Python()  # IronPython2; unwired: IN[0]
# ---------- python_script.python (13 lines) ----------
# Enable Python support and load DesignScript library
# IMPORTANT : ALL DYNAMO DESIGN SCRIPT NODES ARE AS (dg)
import sys
sys.path.append(r'C:\Program Files (x86)\IronPython 2.7\DLLs')
sys.path.append(r'C:\Program Files (x86)\IronPython 2.7\Lib')
import urllib2

scriptsource = "http://synthesize.aecedx.com/Synthesize/DebugPythonNoMessage"

response = urllib2.urlopen(scriptsource)
script = response.read()
	
OUT = script
# ----------------------------------------
python_script_from_string = PythonStringNode(script=python_script)  # IronPython2
VAROut = Output(python_script_from_string)
