# Dynamo custom node Default Linestyles Name Revit Compatiblity.dyf (Dynamo 2.1.0.7500)
# category: Synthesize.Automate.Lines
# Default Linestyles Name Revit Compatiblity

VARLinestylename = Input(VARLinestylename: var[]..[])
python_script = Python(IN[0]=VARLinestylename)
# ---------- python_script.python (48 lines) ----------
import sys
import clr
# Adding the DynamoRevitDS.dll module to work with the Dynamo API
clr.AddReference('DynamoRevitDS')
import Dynamo 
clr.AddReference('DSCoreNodes')
import DSCore
from DSCore import *
clr.AddReference("RevitServices")
from RevitServices.Persistence import DocumentManager
doc = DocumentManager.Instance.CurrentDBDocument
app = DocumentManager.Instance.CurrentUIApplication.Application
# access to the current Dynamo instance and workspace
input = IN[0]
revitversion = app.VersionNumber

if int(revitversion) >= 2021:
	if input == "Axis of Rotation":
		input = "<Axis of Rotation>"
	elif input == "Hidden Lines":
		input = "<Hidden Lines>"
	elif input == "Insulating Batting Lines":
		input = "<Insulating Batting Lines>"
	elif input == "Lines":
		input = "<Lines>"
	elif input == "Medium Lines":
		input = "<Medium Lines>"
	elif input == "Thin Lines":
		input = "<Thin Lines>"
	elif input == "Wide Lines":
		input = "<Wide Lines>"
else:
	if input == "<Axis of Rotation>":
		input = "Axis of Rotation"
	elif input == "<Hidden Lines>":
		input = "Hidden Lines"
	elif input == "<Insulating Batting Lines>":
		input = "Insulating Batting Lines"
	elif input == "<Lines>":
		input = "Lines"
	elif input == "<Medium Lines>":
		input = "Medium Lines"
	elif input == "<Thin Lines>":
		input = "Thin Lines"
	elif input == "<Wide Lines>":
		input = "Wide Lines"

OUT = input
# ----------------------------------------
VARLinestylename_2 = Output(python_script)  # "VARLinestylename"
