# Dynamo custom node DelaFixDesignFace.dyf (Dynamo 2.1.0.7500)
# category: Synthesize.Delaunay
# Delaunay Pattern Fix On Face Design by Karam Baki

VARSelectFaces = Input(VARSelectFaces: var[]..[])
byJoinedSurfaces = PolySurface.ByJoinedSurfaces(surfaces=VARSelectFaces)
surfaces = PolySurface.Surfaces(polySurface=byJoinedSurfaces)
VARFixFactorDependsonProjectUnitsEX2Mete = Input(VARFixFactorDependsonProjectUnitsEX2Meters: var[]..[])
thicken = Surface.Thicken(surface=surfaces, thickness=VARFixFactorDependsonProjectUnitsEX2Mete)
VARRandomU = Input(VARRandomU: var[]..[])
VARRandomV = Input(VARRandomV: var[]..[])
byCoordinates = UV.ByCoordinates(u=VARRandomU, v=VARRandomV)
VARSelectedPoints = Input(VARSelectedPoints: var[]..[])
UVParameterAtPoint = Surface.UVParameterAtPoint(surface=surfaces, point=VARSelectedPoints, lacing=CrossProduct)
create = List.Create(item0=byCoordinates, item1=UVParameterAtPoint)
flatten = List.Flatten(list=create)
boolean = BoolSelector(false)  # graph input
clean = List.Clean(list=flatten, preserveIndices=boolean)
byParametersOnSurface = Tessellation.Delaunay.ByParametersOnSurface(uvs=clean, face=surfaces)
intersect = Geometry.Intersect(geometry=thicken, other=byParametersOnSurface)
flatten_2 = List.Flatten(list=intersect)
startPoint = Curve.StartPoint(curve=flatten_2)
endPoint = Curve.EndPoint(curve=flatten_2)
create_2 = List.Create(item0=startPoint, item1=endPoint)
transpose = List.Transpose(lists=create_2)
VARPairPoints = Output(transpose)
boolean_2 = BoolSelector(false)  # graph input
clean_2 = List.Clean(list=intersect, preserveIndices=boolean_2)
pullOntoSurface = Curve.PullOntoSurface(curve=clean_2, surface=byJoinedSurfaces)
VARCurves = Output(pullOntoSurface)
VARUV = Output(clean)
