# Dynamo custom node Detect Levels of Points.dyf (Dynamo 2.1.0.7500)
# category: Synthesize.Automate.Family
# Detect Levels of Points From Family Refine Levels and Offset

code_block = CodeBlock { 1; }
VARSetOffsetParameter = Input(VARSetOffsetParameter: var[]..[])
VARRoundingFix = Input(VARRoundingFix: var[]..[])
VARPoints = Input(VARPoints: var[]..[])
XYZ = Custom[LF.Point.XYZ](VARpoint=VARPoints)  # Get the X, Y, and Z components of a Point
VARZLocationOffset = Input(VARZLocationOffset: var[]..[])
add = XYZ.VARZ + VARZLocationOffset
byCoordinates = Point.ByCoordinates(x=XYZ.VARX, y=XYZ.VARY, z=add)
Z = Point.Z(point=byCoordinates)
VARRoundingValue = Input(VARRoundingValue: var[]..[])
roundToPrecision = Custom[CW.Math.RoundToPrecision](VARdbl=Z, VARprecision=VARRoundingValue)  # Rounds a number to a specified precision
scopeIf = Custom[CW.ScopeIf+](VARtest=VARRoundingFix, VARtrue=roundToPrecision, VARfalse=Z)  # A (hopefully) more robust implementation of ScopeIf. Tests a single boolean and returns a value accordingly.
VARLevels = Input(VARLevels: var[]..[])
code_block_2 = CodeBlock { "Level"; }
byClassName = Custom[SP.Filter.ByClassName](VARobject=VARLevels, VARclassName=code_block_2)  # Filters a list of objects by the object's class name. Note that Dynamo elements belong to different classes than their Revit counterparts. Use the Object.Class node to check an object's class.
projectElevation = Level.ProjectElevation()  # unwired: level
sortByFunction = List.SortByFunction(list=byClassName.VARin, func=projectElevation)
count = List.Count(list=byCoordinates)
cycle = List.Cycle(list=sortByFunction, amount=count)
count_2 = List.Count(list=sortByFunction)
chop = List.Chop(list=cycle, lengths=count_2)
code_block_3 = CodeBlock { 1; }
chop_2 = List.Chop(list=sortByFunction, lengths=code_block_3)
plane = Custom[CW.Level.Plane](VARlevel=chop_2)  # Retrieves the plane of a given level
boundingBox = Geometry.BoundingBox(geometry=plane)
flatten = List.Flatten(list=boundingBox)
minPoint = BoundingBox.MinPoint(boundingBox=flatten)
maxPoint = BoundingBox.MaxPoint(boundingBox=flatten)
X = Point.X(point=maxPoint)
VARFixFactorDependsofProjectUnits1Formet = Input(VARFixFactorDependsofProjectUnits1Formetersforexampleand100forCentimeters: var[]..[])
mul = X * VARFixFactorDependsofProjectUnits1Formet
Y = Point.Y(point=maxPoint)
mul_2 = Y * VARFixFactorDependsofProjectUnits1Formet
projectElevation_2 = Level.ProjectElevation(level=sortByFunction)
code_block_4 = CodeBlock { -1; }
shiftIndices = List.ShiftIndices(list=projectElevation_2, amount=code_block_4)
getKeys = GetKeys(list=shiftIndices)
lastItem = List.LastItem(list=getKeys)
maximumItem = List.MaximumItem(list=shiftIndices)
code_block_5 = CodeBlock { 2; }
mul_3 = maximumItem * code_block_5
replaceItemAtIndex = List.ReplaceItemAtIndex(list=shiftIndices, index=lastItem, item=mul_3)
dm_fix_point_bycoordinates_range = Custom[DM.Fix Point.ByCoordinates Range](VARx=mul, VARy=mul_2, VARz=replaceItemAtIndex)  # Dummy Node to fix the modelling range warning
byCorners = BoundingBox.ByCorners(min=minPoint, max=dm_fix_point_bycoordinates_range)
contains = BoundingBox.Contains(boundingBox=byCorners, point=byCoordinates@L1)
filterByBoolMask = List.FilterByBoolMask(list=chop, mask=contains)
python_empty_2_null = Custom[Python Empty 2 Null](VARIN=filterByBoolMask.in)  # Python Null 2 Empty
rank = List.Rank(list=python_empty_2_null)
normalizeDepth = List.NormalizeDepth(list=python_empty_2_null, rank=rank)
code_block_6 = CodeBlock { 1; }
chop_3 = List.Chop(list=normalizeDepth, lengths=code_block_6)
flatten_2 = List.Flatten(list=chop_3@L2)
projectElevation_3 = Level.ProjectElevation()  # unwired: level
sortByFunction_2 = List.SortByFunction(list=flatten_2@L2, func=projectElevation_3)
lastItem_2 = List.LastItem(list=sortByFunction_2@L2)
bk_find_nearest_revit_level_for = Custom[BK.Find Nearest Revit Level for a Given Z value](VARzvalue=Z@L1)
flatten_3 = List.Flatten(list=bk_find_nearest_revit_level_for)
isNull = Object.IsNull()  # unwired: obj
replaceByCondition = Replace(item=lastItem_2, replaceWith=flatten_3, condition=isNull)
flatten_4 = List.Flatten(list=replaceByCondition)
projectElevation_4 = Level.ProjectElevation(level=flatten_4)
sub = scopeIf - projectElevation_4
code_block_7 = CodeBlock { null; false; }
scopeIf_2 = Custom[CW.ScopeIf+](VARtest=VARSetOffsetParameter, VARtrue=sub, VARfalse=code_block_7.out0)
clean = List.Clean(list=scopeIf_2, preserveIndices=code_block_7.out1)
VARElevationsSet = Output(clean)
VARLevelsSet = Output(flatten_4)
VARSelectedLevels = Output(sortByFunction)
