# Dynamo custom node Determine Intersecting Curves.dyf (Dynamo 2.1.0.7500)
# category: Synthesize.Automate.Lines
# Prepare K-Paneling Manual Lines UV

VARFaces = Input(VARFaces: var[]..[])
flatten = List.Flatten(list=VARFaces)
VARSurfaces = Output(flatten)
VARElements = Input(VARElements: var[]..[])
flatten_2 = List.Flatten(list=VARElements)
prepare_k_paneling_manual_lines = Custom[Prepare K-Paneling Manual Lines](VARSurfaces=flatten, VARElements=flatten_2)  # Prepare K-Paneling Manual Lines
group_curves_by_surfaces = Custom[Group Curves By Surfaces](VARSurfaces=flatten, VARCurves=prepare_k_paneling_manual_lines)  # Group Curves By Surfaces
as_polycurve_bycurves_with = Custom[AS.[&] PolyCurve.ByCurves With Failures](VARcurves=group_curves_by_surfaces.VARCurves)  # Create polycurves from an unordered list of curves.
code_block = CodeBlock { 2; }
normalizeDepth = List.NormalizeDepth(list=as_polycurve_bycurves_with.VARpolyCurve, rank=code_block)
VARCurves = Output(normalizeDepth)
