# Dynamo custom node Dimensions Start End Points.dyf (Dynamo 2.1.0.7500)
# category: Synthesize.Automate.Dimensions
# Dimensions Start End Points

VARDimensions = Input(VARDimensions: var[]..[])
python_script = Python(IN[0]=VARDimensions)
# ---------- python_script.python (105 lines) ----------
# Enable Python support and load DesignScript library
# IMPORTANT : ALL DYNAMO DESIGN SCRIPT NODES ARE AS (dg)
import clr
clr.AddReference('ProtoGeometry')
from Autodesk.DesignScript import Geometry as dg

# EXTENSION Enable ToDSType
clr.AddReference('RevitNodes')
import Revit
clr.ImportExtensions(Revit.Elements)

# Enable Revit Elements
from Revit.Elements import *

# EXTENSION Enable Geometry Conversion Methods
clr.ImportExtensions(Revit.GeometryConversion)

# Enable Revit API
clr.AddReference('RevitAPI')
from Autodesk.Revit.DB import *

# Enable DocumentManager and TransactionManager
clr.AddReference('RevitServices')
from RevitServices.Persistence import DocumentManager
from RevitServices.Transactions import TransactionManager

# Enable ICollection List Translate
clr.AddReference("System")
import System.Collections.Generic
from System.Collections.Generic import List

def tolist(obj1):
	if hasattr(obj1,'__iter__'): return obj1
	else: return [obj1]

def GetDimensionStartPoint(dim):
	try:
		p = [dim.Origin]
		segs = [None]
	except:
		p = []
		segs = []
		for seg in dim.Segments:
			p.append(seg.Origin)
			segs.append(seg)
	return p,segs

def GetDimensionPoints(dim,pStart,seg):
	dynpoints = []
	try:
		dimLine = dim.Curve
		pts = List[XYZ]()
		dimLine.MakeBound(0,1)
		pt1 = dimLine.GetEndPoint(0)
		pt2 = dimLine.GetEndPoint(1)
		direction = pt2.Subtract(pt1).Normalize()
		if(dim.Segments.Size == 0):
			v = 0.5 * dim.Value * direction
			pts.Add( pStart - v )
			pts.Add( pStart + v )
		else:
			p = pStart
			v = seg.Value * direction
			if pts.Count == 0:
				p = pStart-0.5*v
				pts.Add(p)
			p  = p.Add(v)
			pts.Add(p)
		for e in pts:
			dynpoints.append(e.ToPoint())
	except:
		dynpoints.append(None)
	return dynpoints

dataEnteringNode = IN
# Use UnwrapElement(IN[0]) When Translating From Dynamo to Revit
dim = UnwrapElement(IN[0])
dim = tolist(dim)

# Choose The Current Document
doc = DocumentManager.Instance.CurrentDBDocument
uidoc = DocumentManager.Instance.CurrentUIApplication.ActiveUIDocument
uiapp = DocumentManager.Instance.CurrentUIApplication
app = uiapp.Application

result = []

for d in dim:
	pStart = GetDimensionStartPoint(d)
	counter = 0
	tmplist = []
	for e in pStart[1]:
		pts = GetDimensionPoints(d,pStart[0][counter],pStart[1][counter])
		try:
			prunedpts = dg.Point.PruneDuplicates(pts)
		except:
			pass
		counter += 1
		if len(prunedpts) > 1:
			tmplist.append(pts)
		else:
			tmplist.append(None)
	result.append(tmplist)

OUT = result
# ----------------------------------------
VARStartEndPoints = Output(python_script)
