# Dynamo custom node DisableReferencePlanes.dyf (Dynamo 2.13.1.3887)
# category: Synthesize.Automate.Family
# DisableReferencePlanes

VARFamilyTypes = Input(VARFamilyTypes: var[]..[])
python_script = Python(IN[0]=VARFamilyTypes)  # IronPython2
# ---------- python_script.python (98 lines) ----------
# Created By Karam Baki : karam@aecedx.com
# Enable Python support and load DesignScript library
# IMPORTANT : ALL DYNAMO DESIGN SCRIPT NODES ARE AS (dg)
import clr
clr.AddReference('ProtoGeometry')
from Autodesk.DesignScript import Geometry as dg

# EXTENSION Enable ToDSType
clr.AddReference('RevitNodes')
import Revit
clr.ImportExtensions(Revit.Elements)

# Enable Revit Elements
from Revit.Elements import *

# EXTENSION Enable Geometry Conversion Methods
clr.ImportExtensions(Revit.GeometryConversion)

# Enable Revit API
clr.AddReference('RevitAPI')
from Autodesk.Revit.DB import *

# Enable DocumentManager and TransactionManager
clr.AddReference('RevitServices')
from RevitServices.Persistence import DocumentManager
from RevitServices.Transactions import TransactionManager

# Enable ICollection List Translate
clr.AddReference("System")
import System.Collections.Generic
from System.Collections.Generic import List

import sys
sys.path.append(r'C:\Program Files (x86)\IronPython 2.7\DLLs')
sys.path.append(r'C:\Program Files (x86)\IronPython 2.7\Lib')
from collections import Iterable

doc = DocumentManager.Instance.CurrentDBDocument
app = doc.Application

class FamOpt1(IFamilyLoadOptions):
	def __init__(self):
		pass
	def OnFamilyFound(self,familyInUse, overwriteParameterValues):
		return True
	def OnSharedFamilyFound(self,familyInUse, source, overwriteParameterValues):
		return True

def tolist(obj1):
	if hasattr(obj1,'__iter__'): return obj1
	else: return [obj1]

def flatten(x):
    result = []
    for el in x:
        if hasattr(el, "__iter__") and not isinstance(el, basestring):
            result.extend(flatten(el))
        else:
            result.append(el)
    return result

# Simple Warning Swallow Class
class WarnSwallowSimple(IFailuresPreprocessor):
	def PreprocessFailures(self, failuresAccessor):
		failuresAccessor.DeleteAllWarnings()
		return FailureProcessingResult.Continue

familytype = UnwrapElement(flatten(tolist(IN[0])))

def changerefs(familytype):
	TransactionManager.Instance.ForceCloseTransaction()
	famdoc = doc.EditFamily(familytype.Family)
	TransactionManager.Instance.ForceCloseTransaction()
	trans1 = Transaction(famdoc, 'Disable Reference Planes')
	trans1.Start()
	warnhandle = WarnSwallowSimple()
	foptions = trans1.GetFailureHandlingOptions()
	foptions.SetFailuresPreprocessor(warnhandle)
	trans1.SetFailureHandlingOptions(foptions)
	try:
		reflines = [x for x in FilteredElementCollector(famdoc).OfClass(ReferencePlane).ToElements()]
		for r in reflines:
			try:
				param = r.LookupParameter("Is Reference")
				param.Set(12)
			except:
				pass
		trans1.Commit()
		family1 = famdoc.LoadFamily(doc, FamOpt1() )
		famdoc.Close(False)
	except:
		trans1.RollBack()
		famdoc.Close(False)

for e in familytype:
	changerefs(e)

OUT = "Done"
# ----------------------------------------
VAROUT = Output(python_script)
