# Dynamo custom node DividedSurface.Without Layout.dyf (Dynamo 2.1.0.7500)
# category: Synthesize.Automate.Surface
# DividedSurface.Without Layout

code_block = CodeBlock { "SPACING_LAYOUT_U"; "SPACING_LAYOUT_V"; }
VARDividedSurfaces = Input(VARDividedSurfaces: var[]..[])
flatten = List.Flatten(list=VARDividedSurfaces)
code_block_2 = CodeBlock { 0; }
turnIntoList = Custom[CW.TurnIntoList](VARunknownItem=code_block_2)  # Turns an element (or a nested list) into a flat list
al_set_builtin_parameter = Custom[AL.Set BuiltIn Parameter](VARParameterName=code_block.out1, VARElements=flatten@L1, VARParameterValues=turnIntoList)  # This node will take an input of a built in parameter name and set that parameter to given value for given elements.
al_set_builtin_parameter_2 = Custom[AL.Set BuiltIn Parameter](VARParameterName=code_block.out0, VARElements=flatten@L1, VARParameterValues=turnIntoList)
join = List.Join(list0=al_set_builtin_parameter, list1=al_set_builtin_parameter_2)
uniqueItems = List.UniqueItems(list=join)
VARDividedSurface = Output(uniqueItems)
