# Dynamo custom node Does Intersect Fixer.dyf (Dynamo 2.1.0.7500)
# category: Synthesize.Fixers
# Does Intersect Fixer

VARgeometry = Input(VARgeometry: Autodesk.DesignScript.Geometry.Geometry)
doesIntersect = Geometry.DoesIntersect(geometry=VARgeometry, other=VARgeometry@L1)
VARbool = Output(doesIntersect)
