# Dynamo custom node Dyna Split.dyf (Dynamo 2.1.0.7500)
# category: Synthesize.Automate.Solid
# Dynamo Split Node

VARGeometry = Input(VARGeometry: var[]..[])
explode = Geometry.Explode(geometry=VARGeometry)
flatten = List.Flatten(list=explode)
code_block = CodeBlock { "Solid"; }
byClassName = Custom[SP.Filter.ByClassName](VARobject=flatten, VARclassName=code_block)  # Filters a list of objects by the object's class name. Note that Dynamo elements belong to different classes than their Revit counterparts. Use the Object.Class node to check an object's class.
code_block_2 = CodeBlock { "Surface"; }
byClassName_2 = Custom[SP.Filter.ByClassName](VARobject=byClassName.VARout, VARclassName=code_block_2)
create = List.Create(item0=byClassName.VARin, item1=byClassName_2.VARin)
code_block_3 = CodeBlock { false; }
clean = List.Clean(list=create, preserveIndices=code_block_3)
flatten_2 = List.Flatten(list=clean)
VARGeometry_2 = Input(VARGeometry: var[]..[])
geometry = Element.Geometry(element=VARGeometry_2)
code_block_4 = CodeBlock { "Solid"; }
byClassName_3 = Custom[SP.Filter.ByClassName](VARobject=geometry, VARclassName=code_block_4)
code_block_5 = CodeBlock { "Surface"; }
byClassName_4 = Custom[SP.Filter.ByClassName](VARobject=byClassName_3.VARout, VARclassName=code_block_5)
create_2 = List.Create(item0=byClassName_3.VARin, item1=byClassName_4.VARin)
code_block_6 = CodeBlock { false; }
clean_2 = List.Clean(list=create_2, preserveIndices=code_block_6)
flatten_3 = List.Flatten(list=clean_2)
as_geometry_splitbytools = Custom[AS.[&] Geometry.SplitByTools](VARgeometry=flatten_2, VARtools=flatten_3)  # Split one piece of geometry (other than a polysurface) by multiple tools
code_block_7 = CodeBlock { false; }
clean_3 = List.Clean(list=as_geometry_splitbytools, preserveIndices=code_block_7)
flatten_4 = List.Flatten(list=clean_3)
code_block_8 = CodeBlock { true; }
dynamo_geometry_to_revit = Custom[Dynamo Geometry To Revit Compatibility](VARGeometryOrSat=flatten_4, VARPreferImportInstance=code_block_8, VARReturnFailures=code_block_8)  # Dynamo Geometry To Revit Compatibility
VARImportInstance = Output(dynamo_geometry_to_revit)
