# Dynamo custom node DynaForm Complex Surface.dyf (Dynamo 2.1.0.7500)
# category: Synthesize.Automate.Surface
# Creates Nurbs Surface by Points in a Smart way

VARImporttoRevit = Input(VARImporttoRevit: var[]..[])
VAROrganic = Input(VAROrganic: var[]..[])
VARPoints = Input(VARPoints: var[]..[])
code_block = CodeBlock { "Reference Point"; }
filterByString = Custom[ST.List.FilterByString](VARlist=VARPoints, VARString=code_block)  # Filter a list by a string match
code_block_2 = CodeBlock { "Name"; }
getParameterValueByName = Element.GetParameterValueByName(element=filterByString.VARMatch, parameterName=code_block_2)
string = StringInput("")
eq = getParameterValueByName == string
filterByBoolMask = List.FilterByBoolMask(list=filterByString.VARMatch, mask=eq)
code_block_3 = CodeBlock { "[A-Z]+"; }
code_block_4 = CodeBlock { "Name"; }
getParameterValueByName_2 = Element.GetParameterValueByName(element=filterByBoolMask.out, parameterName=code_block_4)
findRegularExpression = Custom[CW.String.FindRegularExpression](VARRegEx=code_block_3, VARstr=getParameterValueByName_2)  # Returns all occurences of a regular expression within a string (or list of strings). The syntax for regular expressions is explained at http://ironpython-test.readthedocs.org/en/latest/howto/regex.html
flatten = List.Flatten(list=findRegularExpression)
uniqueItems = List.UniqueItems(list=flatten)
length = String.Length()  # unwired: str
groupByFunction = List.GroupByFunction(list=uniqueItems, func=length)
sort = List.Sort(list=groupByFunction@L2)
flatten_2 = List.Flatten(list=sort)
code_block_5 = CodeBlock { 1; }
chop = List.Chop(list=flatten_2, lengths=code_block_5)
eq_2 = chop@L1 == flatten
anyTrue = Custom[CW.List.AnyTrue](VARseq=eq_2)  # Returns true if any item in a list of booleans is true.
filterByBoolMask_2 = List.FilterByBoolMask(list=eq_2, mask=anyTrue)
count = List.Count(list=filterByBoolMask_2.in)
ofRepeatedItem = List.OfRepeatedItem(item=filterByBoolMask.out, amount=count)
filterByBoolMask_3 = List.FilterByBoolMask(list=ofRepeatedItem, mask=filterByBoolMask_2.in)
flatten_3 = List.Flatten(list=filterByBoolMask_3.in@L2)
code_block_6 = CodeBlock { "[0.0-9.0]+"; }
code_block_7 = CodeBlock { "Name"; }
getParameterValueByName_3 = Element.GetParameterValueByName(element=flatten_3, parameterName=code_block_7)
string_from_object = FromObject(obj=getParameterValueByName_3)
findRegularExpression_2 = Custom[CW.String.FindRegularExpression](VARRegEx=code_block_6, VARstr=string_from_object)
flatten_4 = List.Flatten()  # unwired: list
map = List.Map(list=findRegularExpression_2, f_x=flatten_4)
toNumber = String.ToNumber(str=map)
sortIndexByValue = List.SortIndexByValue(list=toNumber)
getItemAtIndex = List.GetItemAtIndex(list=flatten_3, index=sortIndexByValue, lacing=Longest)
point = ReferencePoint.Point(referencePoint=getItemAtIndex)
code_block_8 = CodeBlock { null; }
scopeIf = Custom[CW.ScopeIf+](VARtest=VAROrganic, VARtrue=point, VARfalse=code_block_8)  # A (hopefully) more robust implementation of ScopeIf. Tests a single boolean and returns a value accordingly.
code_block_9 = CodeBlock { false; }
clean = List.Clean(list=scopeIf, preserveIndices=code_block_9)
VARClosed = Input(VARClosed: var[]..[])
firstItem = List.FirstItem(list=clean)
create = List.Create(item0=firstItem)
code_block_10 = CodeBlock { null; }
scopeIf_2 = Custom[CW.ScopeIf+](VARtest=VARClosed, VARtrue=create, VARfalse=code_block_10)
join = List.Join(list0=clean, list1=scopeIf_2)
code_block_11 = CodeBlock { false; }
clean_2 = List.Clean(list=join, preserveIndices=code_block_11)
code_block_12 = CodeBlock { 3; }
create_2 = List.Create(item0=code_block_8)
scopeIf_3 = Custom[CW.ScopeIf+](VARtest=VAROrganic, VARtrue=code_block_12, VARfalse=create_2)
clean_3 = List.Clean(list=scopeIf_3, preserveIndices=code_block_9)
byPoints = NurbsSurface.ByPoints(points=clean_2, uDegree=clean_3, vDegree=clean_3)
create_3 = List.Create(item0=byPoints)
code_block_13 = CodeBlock { null; }
replaceEmptyLists = Custom[CW.List.ReplaceEmptyLists](VARseq=create_3, VARReplacement=code_block_13)  # Replaces all empty lists within a given list with a substitute
flatten_5 = List.Flatten(list=replaceEmptyLists)
clean_4 = List.Clean(list=flatten_5)
VARGetSolidOnlyifOrganic = Input(VARGetSolidOnlyifOrganic: var[]..[] = FalseandClosed = True;)
byCoordinates = Point.ByCoordinates()
code_block_14 = CodeBlock { 1; 1; }
byCoordinates_2 = Point.ByCoordinates(x=code_block_14.out0)
create_4 = List.Create(item0=byCoordinates, item1=byCoordinates_2)
byCoordinates_3 = Point.ByCoordinates(y=code_block_14.out1)
byCoordinates_4 = Point.ByCoordinates(x=code_block_14.out1, y=code_block_14.out1)
create_5 = List.Create(item0=byCoordinates_3, item1=byCoordinates_4)
create_6 = List.Create(item0=create_4, item1=create_5)
code_block_15 = CodeBlock { null; }
scopeIf_4 = Custom[CW.ScopeIf+](VARtest=VAROrganic, VARtrue=create_6, VARfalse=code_block_15)
code_block_16 = CodeBlock { true; }
clean_5 = List.Clean(list=scopeIf_4, preserveIndices=code_block_16)
uniqueItems_2 = List.UniqueItems(list=clean_5)
clean_6 = List.Clean(list=uniqueItems_2, preserveIndices=code_block_16)
scopeIf_5 = Custom[CW.ScopeIf+](VARtest=VAROrganic, VARtrue=clean_6, VARfalse=point)
uniqueItems_3 = List.UniqueItems(list=scopeIf_5@L2)
clean_7 = List.Clean(list=uniqueItems_3, preserveIndices=code_block_9)
byPoints_2 = PolyCurve.ByPoints(points=clean_7, connectLastToFirst=VARClosed)
byLoft = Surface.ByLoft(crossSections=byPoints_2)
firstItem_2 = List.FirstItem(list=byPoints_2)
code_block_17 = CodeBlock { null; }
scopeIf_6 = Custom[CW.ScopeIf+](VARtest=VARClosed, VARtrue=firstItem_2, VARfalse=code_block_17)
code_block_18 = CodeBlock { false; }
clean_8 = List.Clean(list=scopeIf_6, preserveIndices=code_block_18)
byPatch = Surface.ByPatch(closedCurve=clean_8)
lastItem = List.LastItem(list=byPoints_2)
scopeIf_7 = Custom[CW.ScopeIf+](VARtest=VARClosed, VARtrue=lastItem, VARfalse=code_block_17)
clean_9 = List.Clean(list=scopeIf_7, preserveIndices=code_block_18)
byPatch_2 = Surface.ByPatch(closedCurve=clean_9)
create_7 = List.Create(item0=byLoft, item1=byPatch, item2=byPatch_2)
flatten_6 = List.Flatten(list=create_7)
byJoinedSurfaces = Solid.ByJoinedSurfaces(facesOfSolid=flatten_6)
scopeIf_8 = Custom[CW.ScopeIf+](VARtest=VARGetSolidOnlyifOrganic, VARtrue=byJoinedSurfaces, VARfalse=flatten_6)
scopeIf_9 = Custom[CW.ScopeIf+](VARtest=VAROrganic, VARtrue=clean_4, VARfalse=scopeIf_8)
uniqueItems_4 = List.UniqueItems(list=scopeIf_9)
code_block_19 = CodeBlock { null; }
scopeIf_10 = Custom[CW.ScopeIf+](VARtest=VARImporttoRevit, VARtrue=uniqueItems_4, VARfalse=code_block_19)
code_block_20 = CodeBlock { true; }
dynamo_geometry_to_revit = Custom[Dynamo Geometry To Revit Compatibility](VARGeometryOrSat=scopeIf_10, VARPreferImportInstance=code_block_20, VARReturnFailures=code_block_20)  # Dynamo Geometry To Revit Compatibility
VARImportInstance = Output(dynamo_geometry_to_revit)
VARGeometry = Output(uniqueItems_4)
