# Dynamo custom node DynaForm Complex T-Surface Bridge.dyf (Dynamo 2.1.0.7500)
# category: Synthesize.Automate.Surface
# Bridge Between Faces

code_block = CodeBlock { 2; }
VARtSplineSurface = Input(VARtSplineSurface: Autodesk.DesignScript.Geometry.TSpline.TSplineSurface)
faces = Topology.Faces(topology=VARtSplineSurface)
VARCurvetoFollowandDetectthesurfaces = Input(VARCurvetoFollowandDetectthesurfaces: var[]..[])
curves = Element.Curves(element=VARCurvetoFollowandDetectthesurfaces)
flatten = List.Flatten(list=curves)
count = List.Count(list=flatten)
ofRepeatedItem = List.OfRepeatedItem(item=faces, amount=count)
surfaceGeometry = Face.SurfaceGeometry(face=faces)
startPoint = Curve.StartPoint(curve=flatten)
VARRadiusoftheIntersectingCurve = Input(VARRadiusoftheIntersectingCurve: var[]..[])
endPoint = Curve.EndPoint(curve=flatten)
byTwoPoints = Vector.ByTwoPoints(start=startPoint, end=endPoint)
byCenterPointRadiusNormal = Circle.ByCenterPointRadiusNormal(centerPoint=startPoint, radius=VARRadiusoftheIntersectingCurve, normal=byTwoPoints)
bySweep = Surface.BySweep(profile=byCenterPointRadiusNormal, path=flatten)
doesIntersect = Geometry.DoesIntersect(geometry=surfaceGeometry@L2, other=bySweep@L1, lacing=Longest)
filterByBoolMask = List.FilterByBoolMask(list=ofRepeatedItem, mask=doesIntersect)
flatten_2 = List.Flatten(list=filterByBoolMask.in)
count_2 = List.Count(list=flatten_2)
VARtSplineSurface_2 = Input(VARtSplineSurface: Autodesk.DesignScript.Geometry.TSpline.TSplineSurface)
faces_2 = Topology.Faces(topology=VARtSplineSurface_2)
ofRepeatedItem_2 = List.OfRepeatedItem(item=faces_2, amount=count)
surfaceGeometry_2 = Face.SurfaceGeometry(face=faces_2)
doesIntersect_2 = Geometry.DoesIntersect(geometry=surfaceGeometry_2@L2, other=bySweep@L1, lacing=Longest)
filterByBoolMask_2 = List.FilterByBoolMask(list=ofRepeatedItem_2, mask=doesIntersect_2)
flatten_3 = List.Flatten(list=filterByBoolMask_2.in)
count_3 = List.Count(list=flatten_3)
lt = count_2 < count_3
scopeIf = Custom[CW.ScopeIf+](VARtest=lt, VARtrue=count_2, VARfalse=count_3)  # A (hopefully) more robust implementation of ScopeIf. Tests a single boolean and returns a value accordingly.
takeItems = List.TakeItems(list=flatten_2, amount=scopeIf)
takeItems_2 = List.TakeItems(list=flatten_3, amount=scopeIf)
reverse = List.Reverse(list=flatten)
VARframeRotations = Input(VARframeRotations: int[])
VARspansCounts = Input(VARspansCounts: int[])
VARflipAlignmentFlags = Input(VARflipAlignmentFlags: bool[])
bridgeFacesToFaces = TSpline.TSplineSurface.BridgeFacesToFaces(tSplineSurface=VARtSplineSurface, firstGroup=takeItems, secondGroup=takeItems_2, followCurves=reverse, frameRotations=VARframeRotations, spansCounts=VARspansCounts, flipAlignmentFlags=VARflipAlignmentFlags)
VARTSplineSurface = Output(bridgeFacesToFaces)
