# Dynamo custom node DynaForm Complex T-Surface.dyf (Dynamo 2.1.0.7500)
# category: Synthesize.Automate.Surface
# Creates Nurbs Surface by Points in a Smart way

VARPoints = Input(VARPoints: var[]..[])
code_block = CodeBlock { "Reference Point"; }
filterByString = Custom[ST.List.FilterByString](VARlist=VARPoints, VARString=code_block)  # Filter a list by a string match
code_block_2 = CodeBlock { "Name"; }
getParameterValueByName = Element.GetParameterValueByName(element=filterByString.VARMatch, parameterName=code_block_2)
string = StringInput("")
eq = getParameterValueByName == string
filterByBoolMask = List.FilterByBoolMask(list=filterByString.VARMatch, mask=eq)
code_block_3 = CodeBlock { "[A-Z]+"; }
code_block_4 = CodeBlock { "Name"; }
getParameterValueByName_2 = Element.GetParameterValueByName(element=filterByBoolMask.out, parameterName=code_block_4)
findRegularExpression = Custom[CW.String.FindRegularExpression](VARRegEx=code_block_3, VARstr=getParameterValueByName_2)  # Returns all occurences of a regular expression within a string (or list of strings). The syntax for regular expressions is explained at http://ironpython-test.readthedocs.org/en/latest/howto/regex.html
flatten = List.Flatten(list=findRegularExpression)
uniqueItems = List.UniqueItems(list=flatten)
length = String.Length()  # unwired: str
groupByFunction = List.GroupByFunction(list=uniqueItems, func=length)
sort = List.Sort(list=groupByFunction@L2)
flatten_2 = List.Flatten(list=sort)
code_block_5 = CodeBlock { 1; }
chop = List.Chop(list=flatten_2, lengths=code_block_5)
eq_2 = chop@L1 == flatten
anyTrue = Custom[CW.List.AnyTrue](VARseq=eq_2)  # Returns true if any item in a list of booleans is true.
filterByBoolMask_2 = List.FilterByBoolMask(list=eq_2, mask=anyTrue)
count = List.Count(list=filterByBoolMask_2.in)
ofRepeatedItem = List.OfRepeatedItem(item=filterByBoolMask.out, amount=count)
filterByBoolMask_3 = List.FilterByBoolMask(list=ofRepeatedItem, mask=filterByBoolMask_2.in)
flatten_3 = List.Flatten(list=filterByBoolMask_3.in@L2)
code_block_6 = CodeBlock { "[0.0-9.0]+"; }
code_block_7 = CodeBlock { "Name"; }
getParameterValueByName_3 = Element.GetParameterValueByName(element=flatten_3, parameterName=code_block_7)
string_from_object = FromObject(obj=getParameterValueByName_3)
findRegularExpression_2 = Custom[CW.String.FindRegularExpression](VARRegEx=code_block_6, VARstr=string_from_object)
flatten_4 = List.Flatten()  # unwired: list
map = List.Map(list=findRegularExpression_2, f_x=flatten_4)
toNumber = String.ToNumber(str=map)
sortIndexByValue = List.SortIndexByValue(list=toNumber)
getItemAtIndex = List.GetItemAtIndex(list=flatten_3, index=sortIndexByValue, lacing=Longest)
point = ReferencePoint.Point(referencePoint=getItemAtIndex)
code_block_8 = CodeBlock { false; }
clean = List.Clean(list=point, preserveIndices=code_block_8)
VARClosed = Input(VARClosed: var[]..[])
firstItem = List.FirstItem(list=clean)
create = List.Create(item0=firstItem)
code_block_9 = CodeBlock { null; }
scopeIf = Custom[CW.ScopeIf+](VARtest=VARClosed, VARtrue=create, VARfalse=code_block_9)  # A (hopefully) more robust implementation of ScopeIf. Tests a single boolean and returns a value accordingly.
join = List.Join(list0=clean, list1=scopeIf)
code_block_10 = CodeBlock { false; }
clean_2 = List.Clean(list=join, preserveIndices=code_block_10)
byPoints = PolyCurve.ByPoints(points=clean_2)
transpose = List.Transpose(lists=clean_2)
byPoints_2 = PolyCurve.ByPoints(points=transpose)
join_2 = List.Join(list0=byPoints, list1=byPoints_2)
curves = PolyCurve.Curves(polyCurve=join_2)
VARCurves = Output(curves)
