# Dynamo custom node DynaForm Simple Surface.dyf (Dynamo 2.13.1.3887)
# category: Synthesize.Automate.Surface
# Dyna Form Simple Surface
# packages: Synthesize toolkit 12.5.1

VARPoints = Input(VARPoints: var[]..[])
code_block = CodeBlock { "Reference Point"; }
filterByString = Custom[ST.List.FilterByString](VARlist=VARPoints, VARString=code_block)  # package Synthesize toolkit; Filter a list by a string match
code_block_2 = CodeBlock { "Name"; }
getParameterValueByName = Element.GetParameterValueByName(element=filterByString.VARMatch, parameterName=code_block_2)
string = StringInput("")
eq = getParameterValueByName == string
filterByBoolMask = List.FilterByBoolMask(list=filterByString.VARMatch, mask=eq)
code_block_3 = CodeBlock { "[0-9]+"; }
filterByBoolMask_2 = List.FilterByBoolMask(list=getParameterValueByName, mask=eq)
findRegularExpression = Custom[CW.String.FindRegularExpression](VARRegEx=code_block_3, VARstr=filterByBoolMask_2.out)  # package Synthesize toolkit; Returns all occurences of a regular expression within a string (or list of strings). The syntax for regular expressions is explained at http://ironpython-test.readthedocs.org/en/latest/howto/regex.html
flatten = List.Flatten(list=findRegularExpression)
toNumber = String.ToNumber(string=flatten)
as_list_sortbykey = Custom[AS.[&] List.SortByKey](VARlist=filterByBoolMask.out, VARkeys=toNumber)  # package Synthesize toolkit; Sort a list (or lists) according to the order specified by the key list.
create = List.Create(item0=as_list_sortbykey.VARsortedlist, item1=filterByBoolMask.in)
code_block_4 = CodeBlock { false; }
clean = List.Clean(list=create, preserveIndices=code_block_4)
flatten_2 = List.Flatten(list=clean)
point = ReferencePoint.Point(referencePoint=flatten_2)
code_block_5 = CodeBlock { true; }
byPoints = NurbsCurve.ByPoints(points=point, closeCurve=code_block_5)
code_block_6 = CodeBlock { 0.5; }
splitByParameter = Curve.SplitByParameter(curve=byPoints, parameters=code_block_6)
superJoin = Custom[CW.Curve.SuperJoin](VARCurves=splitByParameter)  # package Synthesize toolkit; Join all connected curves into Polycurves even they are intersected
byPatch = Surface.ByPatch(closedCurve=superJoin.VARCurvesamp)
dynamo_geometry_to_revit = Custom[Dynamo Geometry To Revit Compatibility](VARGeometryOrSat=byPatch)  # package Synthesize toolkit; Dynamo Geometry To Revit Compatibility
VARImportInstance = Output(dynamo_geometry_to_revit)
