# Dynamo custom node DynaForm T-Spline Import.dyf (Dynamo 2.1.0.7500)
# category: Synthesize.Automate.Surface
# Import to Revit

VARImporttoRevit = Input(VARImporttoRevit: var[]..[])
VARtSplineSurface = Input(VARtSplineSurface: Autodesk.DesignScript.Geometry.TSpline.TSplineSurface)
code_block = CodeBlock { false; }
toBRep = TSpline.TSplineSurface.ToBRep(tSplineSurface=VARtSplineSurface, matchTopology=code_block)
code_block_2 = CodeBlock { null; }
scopeIf = Custom[CW.ScopeIf+](VARtest=VARImporttoRevit, VARtrue=toBRep, VARfalse=code_block_2)  # A (hopefully) more robust implementation of ScopeIf. Tests a single boolean and returns a value accordingly.
code_block_3 = CodeBlock { true; }
dynamo_geometry_to_revit = Custom[Dynamo Geometry To Revit Compatibility](VARGeometryOrSat=scopeIf, VARPreferImportInstance=code_block_3, VARReturnFailures=code_block_3)  # Dynamo Geometry To Revit Compatibility
VARImportInstance = Output(dynamo_geometry_to_revit)
VARGeometry = Output(toBRep)
