# Dynamo custom node DynaLine.dyf (Dynamo 2.1.0.7500)
# category: Synthesize.Automate.Lines
# Create Dynamo Lines

VARSplineThroughPoints = Input(VARSplineThroughPoints: var[]..[])
VARPairs = Input(VARPairs: var[]..[])
VARPoints = Input(VARPoints: var[]..[])
code_block = CodeBlock { "Reference Point"; }
filterByString = Custom[ST.List.FilterByString](VARlist=VARPoints, VARString=code_block)  # Filter a list by a string match
code_block_2 = CodeBlock { "Name"; }
getParameterValueByName = Element.GetParameterValueByName(element=filterByString.VARMatch, parameterName=code_block_2)
string = StringInput("")
eq = getParameterValueByName == string
filterByBoolMask = List.FilterByBoolMask(list=filterByString.VARMatch, mask=eq)
code_block_3 = CodeBlock { "[0-9]+"; }
filterByBoolMask_2 = List.FilterByBoolMask(list=getParameterValueByName, mask=eq)
findRegularExpression = Custom[CW.String.FindRegularExpression](VARRegEx=code_block_3, VARstr=filterByBoolMask_2.out)  # Returns all occurences of a regular expression within a string (or list of strings). The syntax for regular expressions is explained at http://ironpython-test.readthedocs.org/en/latest/howto/regex.html
flatten = List.Flatten(list=findRegularExpression)
toNumber = String.ToNumber(str=flatten)
as_list_sortbykey = Custom[AS.[&] List.SortByKey](VARlist=filterByBoolMask.out, VARkeys=toNumber)  # Sort a list (or lists) according to the order specified by the key list.
create = List.Create(item0=as_list_sortbykey.VARsortedlist, item1=filterByBoolMask.in)
code_block_4 = CodeBlock { false; }
clean = List.Clean(list=create, preserveIndices=code_block_4)
flatten_2 = List.Flatten(list=clean)
subpairs = Custom[SP.List.Subpairs](VARlist=flatten_2)  # Pair up each list item with the next one and drop the list item.
code_block_5 = CodeBlock { null; false; }
scopeIf = Custom[CW.ScopeIf+](VARtest=VARPairs, VARtrue=subpairs, VARfalse=code_block_5.out0)  # A (hopefully) more robust implementation of ScopeIf. Tests a single boolean and returns a value accordingly.
scopeIf_2 = Custom[CW.ScopeIf+](VARtest=VARPairs, VARtrue=code_block_5.out0, VARfalse=flatten_2)
join = List.Join(list0=scopeIf, list1=scopeIf_2)
clean_2 = List.Clean(list=join, preserveIndices=code_block_5.out1)
code_block_6 = CodeBlock { null; }
scopeIf_3 = Custom[CW.ScopeIf+](VARtest=VARSplineThroughPoints, VARtrue=clean_2, VARfalse=code_block_6)
code_block_7 = CodeBlock { false; }
clean_3 = List.Clean(list=scopeIf_3, preserveIndices=code_block_7)
VARIsReference = Input(VARIsReference: var[]..[])
code_block_8 = CodeBlock { null; }
scopeIf_4 = Custom[CW.ScopeIf+](VARtest=VARSplineThroughPoints, VARtrue=VARIsReference, VARfalse=code_block_8)
create_2 = List.Create(item0=scopeIf_4)
code_block_9 = CodeBlock { false; }
clean_4 = List.Clean(list=create_2, preserveIndices=code_block_9)
flatten_3 = List.Flatten(list=clean_4)
byReferencePoints = CurveByPoints.ByReferencePoints(points=clean_3@L2, isReferenceLine=flatten_3)
code_block_10 = CodeBlock { null; }
point = ReferencePoint.Point(referencePoint=clean_2)
flatten_4 = List.Flatten(list=point)
flatten_5 = List.Flatten(list=point)
count = List.Count(list=flatten_5)
code_block_11 = CodeBlock { 3; }
le = count <= code_block_11
code_block_12 = CodeBlock { 2; }
scopeIf_5 = Custom[CW.ScopeIf+](VARtest=le, VARtrue=code_block_12, VARfalse=code_block_11)
byControlPoints = NurbsCurve.ByControlPoints(points=flatten_4, degree=scopeIf_5)
code_block_13 = CodeBlock { 1; 0; }
VARDivisions = Input(VARDivisions: double)
sequence = Sequence(start=code_block_13.out0, amount=VARDivisions, step=code_block_13.out0, lacing=Longest)
remapRange = Math.RemapRange(numbers=sequence, newMin=code_block_13.out1, newMax=code_block_13.out0)
pointAtParameter = Curve.PointAtParameter(curve=byControlPoints@L1, param=remapRange)
scopeIf_6 = Custom[CW.ScopeIf+](VARtest=VARSplineThroughPoints, VARtrue=code_block_10, VARfalse=pointAtParameter)
code_block_14 = CodeBlock { false; }
clean_5 = List.Clean(list=scopeIf_6, preserveIndices=code_block_14)
byPoint = ReferencePoint.ByPoint(pt=clean_5)
scopeIf_7 = Custom[CW.ScopeIf+](VARtest=VARSplineThroughPoints, VARtrue=code_block_6, VARfalse=byPoint)
code_block_15 = CodeBlock { false; }
clean_6 = List.Clean(list=scopeIf_7, preserveIndices=code_block_15)
scopeIf_8 = Custom[CW.ScopeIf+](VARtest=VARSplineThroughPoints, VARtrue=code_block_8, VARfalse=VARIsReference)
create_3 = List.Create(item0=scopeIf_8)
code_block_16 = CodeBlock { false; }
clean_7 = List.Clean(list=create_3, preserveIndices=code_block_16)
flatten_6 = List.Flatten(list=clean_7)
byReferencePoints_2 = CurveByPoints.ByReferencePoints(points=clean_6, isReferenceLine=flatten_6)
create_4 = List.Create(item0=byReferencePoints, item1=byReferencePoints_2)
flatten_7 = List.Flatten(list=create_4)
code_block_17 = CodeBlock { false; }
clean_8 = List.Clean(list=flatten_7, preserveIndices=code_block_17)
VARCurveByPoints = Output(clean_8)
create_5 = List.Create(item0=clean_3, item1=clean_6)
flatten_8 = List.Flatten(list=create_5)
code_block_18 = CodeBlock { false; }
clean_9 = List.Clean(list=flatten_8, preserveIndices=code_block_18)
VARPoints_2 = Output(clean_9)  # "VARPoints"
