# Dynamo custom node Dynamo and Revit Versions.dyf (Dynamo 2.1.0.7500)
# category: Synthesize.Software
# Dynamo and Revit Versions

python_script = Python()
# ---------- python_script.python (11 lines) ----------
import clr
clr.AddReference('RevitAPI')
from Autodesk.Revit.DB import *
clr.AddReference('RevitServices')
from RevitServices.Persistence import DocumentManager
from RevitServices.Transactions import TransactionManager
clr.AddReference('DynamoRevitDS')
import Dynamo 

numversion = float(".".join(Dynamo.Applications.DynamoRevit().RevitDynamoModel.Version.split(".")[0:2]))
OUT = int(DocumentManager.Instance.CurrentUIApplication.Application.VersionNumber), numversion
# ----------------------------------------
code_block = CodeBlock(a=python_script) { a[0]; a[1]; }
VARrevitVersion = Output(code_block.out0)
VARdynamoVersion = Output(code_block.out1)
