# Dynamo custom node Element.BoundingBox Fixer.dyf (Dynamo 2.1.0.7500)
# category: Synthesize.Fixers
# Element.BoundingBox Fixer

VARElement = Input(VARElement: var[]..[])
boundingBox = Element.BoundingBox(element=VARElement)
VARBoundingBox = Output(boundingBox)
