# Dynamo custom node Element.Geometry Fast.dyf (Dynamo 2.1.0.7500)
# category: Synthesize.Automate.Geometry
# Element.Geometry Fast

VARElements = Input(VARElements: var[]..[])
python_script = Python(IN[0]=VARElements)
# ---------- python_script.python (209 lines) ----------
# Created By Karam Baki, karam@aecedx.com
# Inspired By @5devene, dimitar.ven@gmail.com
import clr
import System
from System.Collections.Generic import *

from itertools import repeat

pf_path = System.Environment.GetFolderPath(System.Environment.SpecialFolder.ProgramFilesX86)
import sys
sys.path.append('%s\IronPython 2.7\Lib' %pf_path)
import traceback
import random
import string

clr.AddReference('ProtoGeometry')
from Autodesk.DesignScript.Geometry import *
from Autodesk.DesignScript.Geometry import Point as DynPoint
from Autodesk.DesignScript.Geometry import Line as DynLine
from Autodesk.DesignScript.Geometry import Curve as DynCurve
from Autodesk.DesignScript import Geometry as dg

clr.AddReference('RevitServices')
import RevitServices
from RevitServices.Persistence import DocumentManager
from RevitServices.Transactions import TransactionManager
doc = DocumentManager.Instance.CurrentDBDocument

clr.AddReference('RevitAPI')
from Autodesk.Revit.DB import *
from Autodesk.Revit.DB.Structure import StructuralType

clr.AddReference('RevitNodes')
import Revit
clr.ImportExtensions(Revit.Elements)
clr.ImportExtensions(Revit.GeometryConversion)

clr.AddReference("System")
import System.Collections.Generic
from System.Collections.Generic import List

class WarnSwallow(IFailuresPreprocessor):
	def PreprocessFailures(self, failuresAccessor):
		failuresAccessor.DeleteAllWarnings()
		return FailureProcessingResult.Continue

def on_dialog_open(sender, event):
    try:
        if event.DialogId == 'TaskDialog_Really_Print_Or_Export_Temp_View_Modes':
            event.OverrideResult(1002) 
    except Exception as e:
        pass

def tolist(obj1):
	if hasattr(obj1,'__iter__'): return obj1
	else: return [obj1]

def flatten(x):
    result = []
    try:
    	for el in x:
        	if hasattr(el, "__iter__") and not isinstance(el, basestring):
        	    result.extend(flatten(el))
        	else:
        	    result.append(el)
    except:
    	result = x
    return result

geom = UnwrapElement(IN[0])
if geom != None:
	geom = tolist(geom)
else:
	pass

def cleangeomlist(geoms):
	filteredgeoms = []
	for e in geoms:
		if isinstance(e,str) or isinstance(e,dg.Solid) or isinstance(e,dg.Surface) or isinstance(e,dg.PolySurface) or isinstance(e,dg.Cuboid):
			filteredgeoms.append(e)
	return filteredgeoms

# Better SAT Import Function
def betteimport(doc,sat,temp_path):
	geoms = dg.Geometry.ImportFromSAT(sat)
	geoms = cleangeomlist(geoms)
	sat_path = None
	try:
		if int(DocumentManager.Instance.CurrentUIApplication.Application.VersionNumber) < 2021:
			factor = round(UnitUtils.ConvertFromInternalUnits(3.280839895,doc.GetUnits().GetFormatOptions(UnitType.UT_Length).DisplayUnits),8) * 1000
		else:
			factor = round(UnitUtils.ConvertFromInternalUnits(3.280839895,doc.GetUnits().GetFormatOptions(SpecTypeId.Length).GetUnitTypeId()),8) * 1000
		randomname = ''.join([random.choice(string.ascii_letters + string.digits) for n in xrange(5)])
		sat_path = '%s%s.sat' % (temp_path, randomname)
		dg.Geometry.ExportToSAT(geoms,sat_path,factor)
		for g in geoms:
			g.Dispose()
		scaledgeoms = dg.Geometry.ImportFromSAT(sat_path)
	except:
		scaledgeoms = geoms
	if sat_path != None:
		System.IO.File.Delete(sat_path)
	return scaledgeoms

temp_path = System.IO.Path.GetTempPath()
satOpt = SATExportOptions()
opt1 = Options()

#Find a 3D view type
collector1 = FilteredElementCollector(doc)
viewFamilyTypes = collector1.OfClass((ViewFamilyType))
for e in viewFamilyTypes:
	if str(e.ViewFamily) == "ThreeDimensional":
		viewType = e.Id
		break

def NewForm_background(s1):
	DocumentManager.Instance.CurrentUIApplication.DialogBoxShowing += on_dialog_open
	TransactionManager.Instance.ForceCloseTransaction()
	try:
		randomname = ''.join([random.choice(string.ascii_letters + string.digits) for n in xrange(5)])
		trans1 = Transaction(doc, 'Fetching Geometry')
		foptions = trans1.GetFailureHandlingOptions()
		foptions.SetFailuresPreprocessor(WarnSwallow())
		trans1.SetFailureHandlingOptions(foptions)
		trans1.Start()
		sat_path = '%s%s.sat' % (temp_path, randomname)
		status = True
		finalres = []
		resultgeom = []
		threedeeview = View3D.CreateIsometric(doc, viewType)
		threedeeviewid = threedeeview.Id
		try:
			wantedsub = doc.Settings.Categories.get_Item(BuiltInCategory.OST_Mass)
			threedeeview.SetCategoryHidden(wantedsub.Id,False)
		except:
			pass
		kilist = List[ElementId]([threedeeviewid])
		tid = []
		oldvalues = []
		params = []
		for each in s1:
			try:
				oldvalue = 1
				eparm = each.LookupParameter("Visible")
				if eparm != None:
					if doc.FamilyManager.GetAssociatedFamilyParameter(eparm) != None:
						doc.FamilyManager.AssociateElementParameterToFamilyParameter(eparm, None)
					pname = eparm.Definition.Name
					oldvalue = eparm.AsInteger()
					if oldvalue == 0:
						eparm.Set(1)
			except:
				continue	
			tid.append(each.Id)
		ielements = List[ElementId](tid)
		threedeeview.IsolateElementsTemporary(ielements)
		collectorinside = FilteredElementCollector(doc,threedeeviewid).ToElements()
		elemento = []
		for k in collectorinside:
			elemento.append(int(str(k.Id)))
		for each in s1:
			breakme = True
			if int(str(each.Id)) in elemento:
				doc.Export(temp_path, randomname, kilist, satOpt)
				eachlist = betteimport(doc,sat_path,temp_path)
				System.IO.File.Delete(sat_path)
				if eachlist == []:
					ieach = List[ElementId]([each.Id])
					try:
						if PartUtils.AreElementsValidForCreateParts(doc,ieach):
							part = PartUtils.CreateParts(doc,ieach)
							threedeeview.PartsVisibility = PartsVisibility.ShowPartsOnly
							doc.Regenerate()
							doc.Export(temp_path, randomname, kilist, satOpt)
							eachlist = betteimport(doc,sat_path,temp_path)
							System.IO.File.Delete(sat_path)
							threedeeview.PartsVisibility = PartsVisibility.ShowOriginalOnly
							fetchparts = PartUtils.GetAssociatedParts(doc,each.Id,True,True)
							for fetch in fetchparts:
								doc.Delete(fetch)
							breakme = False
					except:
						pass
				tmplist = []
				for e in eachlist:
					tmplist.append(e)
				resultgeom.append(tmplist)
			else:
				resultgeom = [None]
			if breakme:
				break
		finalres.append(flatten(resultgeom))
		counter = 0
		for ov in oldvalues:
			if ov == 0:
				params[counter].Set(0)
			counter += 1
		trans1.RollBack()
		return finalres
	except:
		trans1.RollBack()
		TransactionManager.Instance.ForceCloseTransaction()
		return traceback.format_exc(),''

result = NewForm_background(geom)
OUT = flatten(result)
satOpt.Dispose()
opt1.Dispose()
# ----------------------------------------
VARGeometry = Output(python_script)
