# Dynamo custom node Element.Geometry Fixer.dyf (Dynamo 2.1.0.7500)
# category: Synthesize.Fixers
# Element.Geometry Fixer

VARElement = Input(VARElement: var[]..[])
VARFullUnjoinedGeometry = Input(VARFullUnjoinedGeometry: bool = false)
VARIncludeHiddenGeometry = Input(VARIncludeHiddenGeometry: bool = false)
python_script = Python(IN[0]=VARElement, IN[1]=VARFullUnjoinedGeometry, IN[2]=VARIncludeHiddenGeometry)
# ---------- python_script.python (347 lines) ----------
# Created By Karam Baki, karam@aecedx.com
# Inspired By @5devene, dimitar.ven@gmail.com
import clr
import System
from System.Collections.Generic import *

from itertools import repeat

pf_path = System.Environment.GetFolderPath(System.Environment.SpecialFolder.ProgramFilesX86)
import sys
sys.path.append('%s\IronPython 2.7\Lib' %pf_path)
import traceback
import random
import string

clr.AddReference('ProtoGeometry')
from Autodesk.DesignScript.Geometry import *
from Autodesk.DesignScript.Geometry import Point as DynPoint
from Autodesk.DesignScript.Geometry import Line as DynLine
from Autodesk.DesignScript.Geometry import Curve as DynCurve
from Autodesk.DesignScript import Geometry as dg


clr.AddReference('RevitServices')
import RevitServices
from RevitServices.Persistence import DocumentManager
from RevitServices.Transactions import TransactionManager
doc = DocumentManager.Instance.CurrentDBDocument

clr.AddReference('RevitAPI')
from Autodesk.Revit.DB import *
from Autodesk.Revit.DB.Structure import StructuralType

clr.AddReference('RevitNodes')
import Revit
clr.ImportExtensions(Revit.Elements)
clr.ImportExtensions(Revit.GeometryConversion)

def on_dialog_open(sender, event):
    try:
        if event.DialogId == 'TaskDialog_Really_Print_Or_Export_Temp_View_Modes':
            event.OverrideResult(1002) 
    except Exception as e:
        pass

def cleangeomlist(geoms):
	filteredgeoms = []
	for e in geoms:
		if isinstance(e,str) or isinstance(e,dg.Solid) or isinstance(e,dg.Surface) or isinstance(e,dg.PolySurface) or isinstance(e,dg.Cuboid):
			filteredgeoms.append(e)
	return filteredgeoms

# Better SAT Import Function
def betteimport(doc,sat,temp_path):
	geoms = dg.Geometry.ImportFromSAT(sat)
	sat_path = None
	try:
		if int(DocumentManager.Instance.CurrentUIApplication.Application.VersionNumber) < 2021:
			factor = round(UnitUtils.ConvertFromInternalUnits(3.280839895,doc.GetUnits().GetFormatOptions(UnitType.UT_Length).DisplayUnits),8) * 1000
		else:
			factor = round(UnitUtils.ConvertFromInternalUnits(3.280839895,doc.GetUnits().GetFormatOptions(SpecTypeId.Length).GetUnitTypeId()),8) * 1000
		randomname = ''.join([random.choice(string.ascii_letters + string.digits) for n in xrange(5)])
		sat_path = '%s%s.sat' % (temp_path, randomname)
		dg.Geometry.ExportToSAT(geoms,sat_path,factor)
		for g in geoms:
			g.Dispose()
		scaledgeoms = dg.Geometry.ImportFromSAT(sat_path)
	except:
		scaledgeoms = geoms
	if sat_path != None:
		System.IO.File.Delete(sat_path)
	return scaledgeoms

def tolist(obj1):
	if hasattr(obj1,'__iter__'): return obj1
	else: return [obj1]

def flatten(x):
    result = []
    try:
    	for el in x:
        	if hasattr(el, "__iter__") and not isinstance(el, basestring):
        	    result.extend(flatten(el))
        	else:
        	    result.append(el)
    except:
    	result = x
    return result
    
def analgeom(elem):
	result = []
	try:
		breakstatus = False
		geoms = elem.get_Geometry(opt1)
		extracted = []
		for e in geoms:
			if e.ToString() == "Autodesk.Revit.DB.GeometryInstance":
				try:
					extracted.append(e.GetInstanceGeometry())
				except:
					pass
			elif e.ToString() == "Autodesk.Revit.DB.Solid":
				extracted.append(e)
		if len(extracted) == 0:
			breakstatus = True
		else:
			extracted = flatten(extracted)
			geoms = extracted
		if breakstatus == False:
			for e in geoms:
				try:
					if e.ToString() == "Autodesk.Revit.DB.Solid":
						attempt = e.ToProtoType()
						if attempt == None:
							if len(result) != 0:
								for r in result:
									try: r.Dispose()
									except: pass
							return False
						else:
							result.append(attempt)	
				except:
					if len(result) != 0:
						for r in result:
							try: r.Dispose()
							except: pass
						result = []
						break
		if len(result) == 0:
			return False
		else:
			newresult = []
			for e in result:
				if e != None:
					newresult.append(e)
			if len(newresult) == 0:
				return False
			else:
				return newresult
	except:
		return "Fail"

geom = UnwrapElement(IN[0])
originalnotjoinedgeom = IN[1]
includehiddengeom = IN[2]

if geom != None:
	geom = tolist(geom)
else:
	pass

class WarnSwallow(IFailuresPreprocessor):
	def PreprocessFailures(self, failuresAccessor):
		failuresAccessor.DeleteAllWarnings()
		return FailureProcessingResult.Continue


if originalnotjoinedgeom == True:
	from itertools import compress
	from itertools import combinations
	
	elements = flatten(geom)
	allwalls = True
	
	bboxes = []
	accept = []
	for e in elements:
		try:
			bb = e.get_BoundingBox(None)
			bboxes.append(bb.ToProtoType())
			accept.append(True)
		except:
			accept.append(False)
			
	acceptedelements = list(compress(elements, accept))
	
	tocombineraw = combinations(acceptedelements,2)
	tocombinebboxraw = combinations(bboxes,2)
	
	comb = []
	for i in list(tocombineraw): 
	    comb.append(i)
	
	tocombine = comb
	
	comb2 = []
	for i in list(tocombinebboxraw): 
	    comb2.append(i)
	
	tocombinebbox = comb2
	
	if allwalls == False:
		result = []
		allresult = []
		for eachlist in tocombine:
			tmplist = []
			for each in eachlist:
				if str(each.ToString()) == "Autodesk.Revit.DB.Wall":
					tmplist.append(True)
				else:
					tmplist.append(False)
			result.append(tmplist)
	
		for each in result:
			if all(each) == True:
				allresult.append(False)
			else:
				allresult.append(True)
		filtered = list(compress(tocombine, allresult))
		filteredbbox = list(compress(tocombinebbox, allresult))
	else:
		filtered = tocombine
		filteredbbox = tocombinebbox
	
	BBOX1 = [item[0] for item in filteredbbox]
	BBOX2 = [item[1] for item in filteredbbox]
	
	intersects = []
	
	count = 0
	for each in BBOX1:
		intersects.append(dg.BoundingBox.Intersects(each,BBOX2[count]))
		count = count + 1
	
	count = 0
	for each in BBOX1:
		each.Dispose()
		BBOX2[count].Dispose()
		count = count + 1
	
	intersectingelements = list(compress(filtered, intersects))
	
	listj = len(intersectingelements)
	count = 0
	arejoined = []
	while (count < listj):
			result = JoinGeometryUtils.AreElementsJoined(doc, intersectingelements[count][0], intersectingelements[count][1])
			count = count + 1
			arejoined.append(result)
	
	joined = list(compress(intersectingelements, arejoined))

temp_path = System.IO.Path.GetTempPath()
satOpt = SATExportOptions()
opt1 = Options()

if includehiddengeom == True:
	opt1.IncludeNonVisibleObjects = True

#Find a 3D view type
collector1 = FilteredElementCollector(doc)
viewFamilyTypes = collector1.OfClass((ViewFamilyType))
for e in viewFamilyTypes:
	if str(e.ViewFamily) == "ThreeDimensional":
		viewType = e.Id
		break

def NewForm_background(s1):
	DocumentManager.Instance.CurrentUIApplication.DialogBoxShowing += on_dialog_open
	TransactionManager.Instance.ForceCloseTransaction()
	try:
		randomname = ''.join([random.choice(string.ascii_letters + string.digits) for n in xrange(5)])
		trans1 = Transaction(doc, 'Fetching Geometry')
		foptions = trans1.GetFailureHandlingOptions()
		foptions.SetFailuresPreprocessor(WarnSwallow())
		trans1.SetFailureHandlingOptions(foptions)
		trans1.Start()
		if originalnotjoinedgeom == True:
			jointcount = 0
			while (jointcount < len(joined)):
				try:
					JoinGeometryUtils.UnjoinGeometry(doc, joined[jointcount][0], joined[jointcount][1])
					jointcount = jointcount + 1
				except:
					jointcount = jointcount +1
			doc.Regenerate()
		sat_path = '%s%s.sat' % (temp_path, randomname)
		status = True
		finalres = []
		for each in s1:
			try:
				oldvalue = 1
				eparm = each.LookupParameter("Visible")
				if eparm != None:
					if doc.FamilyManager.GetAssociatedFamilyParameter(eparm) != None:
						doc.FamilyManager.AssociateElementParameterToFamilyParameter(eparm, None)
					pname = eparm.Definition.Name
					oldvalue = eparm.AsInteger()
					if oldvalue == 0:
						eparm.Set(1)
			except:
				continue
			if each.ToString() == "Autodesk.Revit.DB.ImportInstance":
				if "export_to_revit" in each.LookupParameter("Name").AsString():
					opt1.IncludeNonVisibleObjects = True
				else:
					if includehiddengeom == True:
						opt1.IncludeNonVisibleObjects = True
					else:
						opt1.IncludeNonVisibleObjects = False
			resultgeom = analgeom(each)
			if resultgeom == "Fail":
				finalres.append([None])
				continue
			elif resultgeom == False:
				resultgeom = []
				threedeeview = View3D.CreateIsometric(doc, viewType)
				threedeeviewid = threedeeview.Id
				try:
					wantedsub = doc.Settings.Categories.get_Item(BuiltInCategory.OST_Mass)
					threedeeview.SetCategoryHidden(wantedsub.Id,False)
				except:
					pass
				kilist = List[ElementId]([threedeeviewid])
				tid = []
				tid = [each.Id]
				ielements = List[ElementId](tid)
				threedeeview.IsolateElementsTemporary(ielements)
				collectorinside = FilteredElementCollector(doc,threedeeviewid).ToElements()
				elemento = []
				for k in collectorinside:
					elemento.append(int(str(k.Id)))
				if int(str(each.Id)) in elemento:
					doc.Export(temp_path, randomname, kilist, satOpt)
					eachlist = betteimport(doc,sat_path,temp_path)
					tmplist = []
					for e in eachlist:
						tmplist.append(e)
					resultgeom.append(tmplist)
					System.IO.File.Delete(sat_path)
				else:
					resultgeom = [None]
				doc.Delete(threedeeview.Id)
			finalres.append(flatten(resultgeom))
			if oldvalue == 0:
				eparm.Set(0)
		trans1.RollBack()
		return finalres
	except:
		trans1.RollBack()
		TransactionManager.Instance.ForceCloseTransaction()
		return traceback.format_exc(),''

result = NewForm_background(geom)
OUT = result
satOpt.Dispose()
opt1.Dispose()
# ----------------------------------------
VAROut = Output(python_script)
