# Dynamo custom node Element.Geometry With Detail Level.dyf (Dynamo 2.1.0.7500)
# category: Synthesize.Automate.Geometry
# Element.Geometry With Detail Level

VARElements = Input(VARElements: var[]..[])
VARDetailLevel = Input(VARDetailLevel: var[]..[])
VARIncludeHiddenGeometry = Input(VARIncludeHiddenGeometry: bool = false)
python_script = Python(IN[0]=VARElements, IN[1]=VARDetailLevel, IN[2]=VARIncludeHiddenGeometry)
# ---------- python_script.python (136 lines) ----------
# Created By Karam Baki, karam@aecedx.com
import clr
import System
from System.Collections.Generic import *

from itertools import repeat

pf_path = System.Environment.GetFolderPath(System.Environment.SpecialFolder.ProgramFilesX86)
import sys
sys.path.append('%s\IronPython 2.7\Lib' %pf_path)
import traceback
import random
import string

clr.AddReference('ProtoGeometry')
from Autodesk.DesignScript.Geometry import *
from Autodesk.DesignScript.Geometry import Point as DynPoint
from Autodesk.DesignScript.Geometry import Line as DynLine
from Autodesk.DesignScript.Geometry import Curve as DynCurve
from Autodesk.DesignScript import Geometry as dg


clr.AddReference('RevitServices')
import RevitServices
from RevitServices.Persistence import DocumentManager
from RevitServices.Transactions import TransactionManager
doc = DocumentManager.Instance.CurrentDBDocument

clr.AddReference('RevitAPI')
from Autodesk.Revit.DB import *
from Autodesk.Revit.DB.Structure import StructuralType

clr.AddReference('RevitNodes')
import Revit
clr.ImportExtensions(Revit.Elements)
clr.ImportExtensions(Revit.GeometryConversion)

def tolist(obj1):
	if hasattr(obj1,'__iter__'): return obj1
	else: return [obj1]

def flatten(x):
    result = []
    try:
    	for el in x:
        	if hasattr(el, "__iter__") and not isinstance(el, basestring):
        	    result.extend(flatten(el))
        	else:
        	    result.append(el)
    except:
    	result = x
    return result
    
def analgeom(elem):
	result = []
	try:
		breakstatus = False
		geoms = elem.get_Geometry(opt1)
		extracted = []
		for e in geoms:
			if e.ToString() == "Autodesk.Revit.DB.GeometryInstance":
				try:
					extracted.append(e.GetInstanceGeometry())
				except:
					pass
			elif e.ToString() == "Autodesk.Revit.DB.Solid":
				extracted.append(e)
		if len(extracted) == 0:
			breakstatus = True
		else:
			extracted = flatten(extracted)
			geoms = extracted
		if breakstatus == False:
			for e in geoms:
				try:
					if e.ToString() == "Autodesk.Revit.DB.Solid":
						attempt = e.ToProtoType()
						if attempt == None:
							if len(result) != 0:
								for r in result:
									try: r.Dispose()
									except: pass
							return False
						else:
							result.append(attempt)	
				except:
					if len(result) != 0:
						for r in result:
							try: r.Dispose()
							except: pass
						result = []
						break
		if len(result) == 0:
			return False
		else:
			newresult = []
			for e in result:
				if e != None:
					newresult.append(e)
			if len(newresult) == 0:
				return False
			else:
				return newresult
	except:
		return "Fail"

geom = UnwrapElement(IN[0])
detail_level = UnwrapElement(IN[1])
includehiddengeom = IN[2]

if geom != None:
	geom = tolist(geom)
else:
	pass

temp_path = System.IO.Path.GetTempPath()
satOpt = SATExportOptions()
opt1 = Options()

if includehiddengeom == True:
	opt1.IncludeNonVisibleObjects = True
detail = detail_level.ToString()
if detail == "Coarse":
	opt1.DetailLevel = ViewDetailLevel.Coarse
elif detail == "Medium":
	opt1.DetailLevel = ViewDetailLevel.Medium
elif detail == "Fine":
	opt1.DetailLevel = ViewDetailLevel.Fine

result = []
for g in geom:
	result.append(analgeom(g))

OUT = result
satOpt.Dispose()
opt1.Dispose()
# ----------------------------------------
VAROut = Output(python_script)
