# Dynamo custom node Element.SetParameterByName Fixer.dyf (Dynamo 2.1.0.7500)
# category: Synthesize.Fixers
# Element.SetParameterByName Fixer

VARelement = Input(VARelement: Revit.Elements.Element)
VARparameterName = Input(VARparameterName: string)
VARvalue = Input(VARvalue: var)
setParameterByName = Element.SetParameterByName(element=VARelement, parameterName=VARparameterName, value=VARvalue)
VARElement = Output(setParameterByName)
