# Dynamo custom node Elements.Curves Fixer.dyf (Dynamo 2.1.0.7500)
# category: Synthesize.Fixers
# Elements.Curves Fixer

VARElement = Input(VARElement: var[]..[])
curves = Element.Curves(element=VARElement)
VARCurve = Output(curves)  # "VARCurve[]"
