# Dynamo custom node Elevation Analysis.dyf (Dynamo 2.1.0.7500)
# category: Synthesize.Automate.Topography
# Elevation Analysis

VARFullTopo = Input(VARFullTopo: var[]..[])
VARTopography = Input(VARTopography: var[]..[])
code_block = CodeBlock { false; }
polySurface = Custom[ZK.Topography.PolySurface](VARTopography=VARTopography, VARFullTopo=VARFullTopo, VARFullTopoRemovePads=code_block, VARJointoPolysurface=code_block)  # Convert topography element to polysurface
create = List.Create(item0=polySurface.VARSubregionsList, item1=polySurface.VARHostTopography)
code_block_2 = CodeBlock { false; }
clean = List.Clean(list=create, preserveIndices=code_block_2)
flatten = List.Flatten(list=clean)
scopeIf = Custom[CW.ScopeIf+](VARtest=VARFullTopo, VARtrue=flatten, VARfalse=VARTopography)  # A (hopefully) more robust implementation of ScopeIf. Tests a single boolean and returns a value accordingly.
VARAllViews = Input(VARAllViews: var[]..[])
views = Custom[CW.Document.Views]()  # Gets all views in the document - except for 3D view templates (as long as this bug is not fixed: https://github.com/DynamoDS/Dynamo/issues/2970)
VARActiveView = Input(VARActiveView: var[]..[])
scopeIf_2 = Custom[CW.ScopeIf+](VARtest=VARAllViews, VARtrue=views, VARfalse=VARActiveView)
code_block_3 = CodeBlock { 90; }
overrideTransparencyInView = Custom[CW.Element.OverrideTransparencyInView](VARelement=scopeIf, VARview=scopeIf_2@L1, VARtransparencyPercentage=code_block_3)  # Overrides the transparency of an element in a given view
VARElement = Output(overrideTransparencyInView)
VARCategory = Input(VARCategory: var[]..[])
material_name_of_the_surfaces = StringInput("Default")
byName = Material.ByName(name=material_name_of_the_surfaces)
VARStartFactor = Input(VARStartFactor: var[]..[])
count = List.Count(list=polySurface.VARPolySurface)
code_block_4 = CodeBlock { 1; }
sequence = Sequence(start=VARStartFactor, amount=count, step=code_block_4, lacing=Longest)
string_from_object = FromObject(obj=sequence)
byGeometry = DirectShape.ByGeometry(geometry=polySurface.VARPolySurface, category=VARCategory, material=byName, name=string_from_object)
code_block_5 = CodeBlock { 255; 0; 153; 0; }
byARGB = Color.ByARGB(a=code_block_5.out0, r=code_block_5.out1, g=code_block_5.out2, b=code_block_5.out3)
code_block_6 = CodeBlock { 255; 255; 255; 0; }
byARGB_2 = Color.ByARGB(a=code_block_6.out0, r=code_block_6.out1, g=code_block_6.out2, b=code_block_6.out3)
code_block_7 = CodeBlock { 255; 255; 51; 0; }
byARGB_3 = Color.ByARGB(a=code_block_7.out0, r=code_block_7.out1, g=code_block_7.out2, b=code_block_7.out3)
create_2 = List.Create(item0=byARGB, item1=byARGB_2, item2=byARGB_3)

# group: Thanks to LandForm
code_block_8 = CodeBlock { 0.5; }
pointAtParameter = Surface.PointAtParameter(surface=polySurface.VARPolySurface, u=code_block_8, v=code_block_8)
ZRange = Custom[LF.Point.ZRange](VARpoints=pointAtParameter)  # Get all Z components and the minimum and maximum Z components from a list of Points.
code_block_9 = CodeBlock { 3; }
round = Math.Round(number=ZRange.VARmin, digits=code_block_9)
code_block_10 = CodeBlock(p=ZRange.VARdouble, min=round) { p-min; Math.Round(List.MaximumItem(p-min),3); }
code_block_11 = CodeBlock(lst=create_2) { Count(lst)-1; }
code_block_12 = CodeBlock(max=code_block_10.out1, ct=code_block_11) { (0..max..max/ct)/max; }
code_block_13 = CodeBlock(pt=code_block_10.out0, max=code_block_10.out1) { pt/max; }

code_block_14 = CodeBlock { 4; }
round_2 = Math.Round(number=code_block_13, digits=code_block_14)

# group (continued): Thanks to LandForm
color_range = ColorRange(colors=create_2, indices=code_block_12, value=round_2)

overrideColorInView = Element.OverrideColorInView(element=byGeometry, color=color_range)
passthrough = Custom[CW.Passthrough](VARpassThrough=overrideColorInView, VARwaitFor=byGeometry)  # Forces a sequential order of execution. The node wired into the output of the Passthrough node will be executed *after* the node wired into the waitFor input (e.g. important for some Revit operations). The value of the passThrough input will be passed on to the node wired into the output port of the Passthrough node.
VARGroupName = Input(VARGroupName: var[]..[])
fromElements = Custom[CW.Group.FromElements](VARelements=passthrough, VARgroupName=VARGroupName)  # Creates a group from a list of Revit elements
VARGroup = Output(fromElements.VARgroup)
VARDirectShape = Output(byGeometry)
empty = List.Empty()
scopeIf_3 = Custom[CW.ScopeIf+](VARtest=VARAllViews, VARtrue=overrideColorInView, VARfalse=empty)
copy_element_overrides = Custom[Copy Element Overrides](VARViews=views, VARElements=scopeIf_3)  # Copy Element Overrides
VAROverriddenTopography = Output(scopeIf)
