# Dynamo custom node Extract UV Revit Lines.dyf (Dynamo 2.1.0.7500)
# category: Synthesize.Automate.Lines
# Extract UV Revit Lines

VARUFalseVTrue = Input(VARUFalseVTrue: var[]..[])
VARSurfaces = Input(VARSurfaces: var[]..[])
flatten = List.Flatten(list=VARSurfaces)
VARu = Input(VARu: var[]..[])
VARv = Input(VARv: var[]..[])
code_block = CodeBlock(u=VARu, v=VARv) { 0..1..#u; 0..1..#v; }
pointAtParameter = Surface.PointAtParameter(surface=flatten, u=code_block.out0, v=code_block.out1, lacing=CrossProduct)
transpose = List.Transpose(lists=pointAtParameter@L3)
scopeIf = Custom[CW.ScopeIf+](VARtest=VARUFalseVTrue, VARtrue=pointAtParameter, VARfalse=transpose)  # A (hopefully) more robust implementation of ScopeIf. Tests a single boolean and returns a value accordingly.
flatten_2 = List.Flatten(list=scopeIf@L2)
byPoints = NurbsCurve.ByPoints(points=scopeIf)
code_block_2 = CodeBlock { 0.5; }
pointAtParameter_2 = Curve.PointAtParameter(curve=byPoints, param=code_block_2)
normalAtPoint = Surface.NormalAtPoint(surface=flatten, point=pointAtParameter_2)
byOriginNormal = Plane.ByOriginNormal(origin=pointAtParameter_2, normal=normalAtPoint)
byWidthLength = Rectangle.ByWidthLength(plane=byOriginNormal)
byPatch = Surface.ByPatch(closedCurve=byWidthLength)
code_block_3 = CodeBlock { 0.5; 1; 0; }
pointAtParameter_3 = Surface.PointAtParameter(surface=byPatch, u=code_block_3.out0, v=code_block_3.out2)
flatten_3 = List.Flatten(list=pointAtParameter_3)
pointAtParameter_4 = Surface.PointAtParameter(surface=byPatch, u=code_block_3.out0, v=code_block_3.out1)
flatten_4 = List.Flatten(list=pointAtParameter_4)
byStartPointEndPoint = Line.ByStartPointEndPoint(startPoint=pointAtParameter_3, endPoint=pointAtParameter_4)
code_block_4 = CodeBlock { 0.5; }
pointAtParameter_5 = Curve.PointAtParameter(curve=byStartPointEndPoint, param=code_block_4)
normalAtPoint_2 = Surface.NormalAtPoint(surface=byPatch, point=pointAtParameter_5)
planeAtParameter = Curve.PlaneAtParameter(curve=byStartPointEndPoint, param=code_block_4)
code_block_5 = CodeBlock { 90; }
rotate = Vector.Rotate(vector=normalAtPoint_2, plane=planeAtParameter, degrees=code_block_5)
flatten_5 = List.Flatten(list=rotate)
python_script = Python(IN[0]=flatten_3, IN[1]=flatten_4, IN[2]=flatten_5)
# ---------- python_script.python (44 lines) ----------
# Enable Python support and load DesignScript library
# IMPORTANT : ALL DYNAMO DESIGN SCRIPT NODES ARE AS (dg)
import clr
clr.AddReference('ProtoGeometry')
from Autodesk.DesignScript import Geometry as dg

# EXTENSION Enable ToDSType
clr.AddReference('RevitNodes')
import Revit
clr.ImportExtensions(Revit.Elements)

# EXTENSION Enable Geometry Conversion Methods
clr.ImportExtensions(Revit.GeometryConversion)

# Enable DocumentManager and TransactionManager
clr.AddReference('RevitServices')
from RevitServices.Persistence import DocumentManager
from RevitServices.Transactions import TransactionManager


# Choose The Current Document
doc = DocumentManager.Instance.CurrentDBDocument
uidoc = DocumentManager.Instance.CurrentUIApplication.ActiveUIDocument
uiapp = DocumentManager.Instance.CurrentUIApplication
app = uiapp.Application


#unwrap all elements to use with API
xyzstart = UnwrapElement(IN[0])
xyzend = UnwrapElement(IN[1])
xyzvec = UnwrapElement(IN[2])


TransactionManager.Instance.EnsureInTransaction(doc)
planes = []
count = 0
for each in xyzvec:

	planes.append(doc.FamilyCreate.NewReferencePlane(xyzstart[count].ToXyz(), xyzend[count].ToXyz(), each.ToXyz(), doc.ActiveView))
	count = count + 1
TransactionManager.Instance.TransactionTaskDone()

#Assign your output to the OUT variable
OUT = planes
# ----------------------------------------
python_script_2 = Python(IN[0]=python_script)
# ---------- python_script_2.python (56 lines) ----------
import clr
clr.AddReference('ProtoGeometry')
from Autodesk.DesignScript.Geometry import *

# Import Element wrapper extension methods
clr.AddReference("RevitNodes")
import Revit
clr.ImportExtensions(Revit.Elements)

# Import geometry conversion extension methods
clr.ImportExtensions(Revit.GeometryConversion)

# Import DocumentManager and TransactionManager
clr.AddReference("RevitServices")
import RevitServices
from RevitServices.Persistence import DocumentManager
from RevitServices.Transactions import TransactionManager

doc = DocumentManager.Instance.CurrentDBDocument
uiapp = DocumentManager.Instance.CurrentUIApplication
app = uiapp.Application

# Import RevitAPI
clr.AddReference("RevitAPI")
import Autodesk
from Autodesk.Revit.DB import *

doc = DocumentManager.Instance.CurrentDBDocument
uiapp = DocumentManager.Instance.CurrentUIApplication
app = uiapp.Application

# The inputs to this node will be stored as a list in the IN variable.
dataEnteringNode = IN

# Unwrap elements and convert geometry from Dynamo to Revit:

rPlanes = UnwrapElement(IN[0])
result = []
# Set the reference plane as the sketchplane in the active view in another transaction
TransactionManager.Instance.EnsureInTransaction(doc)
for each in rPlanes:
	result.append(SketchPlane.Create(doc,each.Id))

elt = []
for i in rPlanes:
	elt.append(UnwrapElement(i).Id)
cantdelete=[]
for item in elt:
	try:
		doc.Delete(item)
	except:
		cantdelete.append(item)

TransactionManager.Instance.TransactionTaskDone()

OUT = result
# ----------------------------------------
python_script_3 = Python(IN[0]=flatten_2, IN[1]=python_script_2)
# ---------- python_script_3.python (59 lines) ----------
# Enable Python support and load DesignScript library
# IMPORTANT : ALL DYNAMO DESIGN SCRIPT NODES ARE AS (dg)
import clr
clr.AddReference('ProtoGeometry')
from Autodesk.DesignScript import Geometry as dg

# EXTENSION Enable ToDSType
clr.AddReference('RevitNodes')
import Revit
clr.ImportExtensions(Revit.Elements)

# Enable Revit Elements
from Revit.Elements import *

# EXTENSION Enable Geometry Conversion Methods
clr.ImportExtensions(Revit.GeometryConversion)

# Enable Revit API
clr.AddReference('RevitAPI')
from Autodesk.Revit.DB import *

# Enable DocumentManager and TransactionManager
clr.AddReference('RevitServices')
from RevitServices.Persistence import DocumentManager
from RevitServices.Transactions import TransactionManager

# Enable ICollection List Translate
clr.AddReference("System")
import System.Collections.Generic
from System.Collections.Generic import List

doc = DocumentManager.Instance.CurrentDBDocument
app = doc.Application

Pointslist = UnwrapElement(IN[0])
Sketchplanes = UnwrapElement(IN[1])

TransactionManager.Instance.EnsureInTransaction(doc)

ConvertedSketchPlanes = []
for each in Sketchplanes:
	ConvertedSketchPlanes.append(each.GetPlaneReference())

resrefpoints=[]

count = 0
for eachlist in Pointslist:
	tmp = []
	for e in eachlist:
		dynpoints = PointOnPlane.NewPointOnPlane(doc,ConvertedSketchPlanes[count],e.ToXyz(),XYZ(0,0,1))
		dynpoints.SetPlaneReference(ConvertedSketchPlanes[count])
		refpoints = doc.FamilyCreate.NewReferencePoint(dynpoints)
		tmp.append(refpoints)
	resrefpoints.append(tmp)
	count = count + 1

TransactionManager.Instance.TransactionTaskDone()

OUT = resrefpoints
# ----------------------------------------
code_block_6 = CodeBlock { true; }
byReferencePoints = CurveByPoints.ByReferencePoints(points=python_script_3, isReferenceLine=code_block_6)
VARCurveByPoints = Output(byReferencePoints)
VARSketchPlanes = Output(python_script_2)
VARReferencePoints = Output(python_script_3)
