# Dynamo custom node Face to Mass Updater.dyf (Dynamo 2.1.0.7500)
# category: Synthesize.Automate.Family
# Face to Mass Updater

hot_get_all_filter = Custom[HOT.Get All Filter]()  # Get all Filter
string_from_object = FromObject(obj=hot_get_all_filter.VARElement)
code_block = CodeBlock { "SelectionFilterElement"; }
eq = string_from_object == code_block
filterByBoolMask = List.FilterByBoolMask(list=hot_get_all_filter.VARElement, mask=eq)
elements = Custom[CW.SelectionSet.Elements](VARselectionSet=filterByBoolMask.in)  # Retrieves all elements stored in a selection set
isEmpty = List.IsEmpty(list=elements, lacing=Longest)
filterByBoolMask_2 = List.FilterByBoolMask(list=filterByBoolMask.in, mask=isEmpty)
python_all_elements_in_active = Custom[Python All Elements In Active View]()  # Python All Elements In Active View
elements_2 = Custom[CW.SelectionSet.Elements](VARselectionSet=filterByBoolMask_2.out)
contains = List.Contains(list=python_all_elements_in_active, item=elements_2@@L1)
anyTrue = Custom[CW.List.AnyTrue](VARseq=contains)  # Returns true if any item in a list of booleans is true.
filterByBoolMask_3 = List.FilterByBoolMask(list=filterByBoolMask_2.out, mask=anyTrue)
filterByBoolMask_4 = List.FilterByBoolMask(list=hot_get_all_filter.VARName, mask=eq)
filterByBoolMask_5 = List.FilterByBoolMask(list=filterByBoolMask_4.in, mask=isEmpty)
filterByBoolMask_6 = List.FilterByBoolMask(list=filterByBoolMask_5.out, mask=anyTrue)
code_block_2 = CodeBlock { "DONOTDELETE-FACETOMASS"; }
contains_2 = String.Contains(str=filterByBoolMask_6.in, searchFor=code_block_2)
filterByBoolMask_7 = List.FilterByBoolMask(list=filterByBoolMask_3.in, mask=contains_2)
elements_3 = Custom[CW.SelectionSet.Elements](VARselectionSet=filterByBoolMask_7.in)
isEmpty_2 = List.IsEmpty(list=elements_3, lacing=Longest)
filterByBoolMask_8 = List.FilterByBoolMask(list=filterByBoolMask_7.in, mask=isEmpty_2)
eraser = Custom[ST.Tool.Eraser](VARList=filterByBoolMask_8.in)  # Try to delete any element from project
filterByBoolMask_9 = List.FilterByBoolMask(list=filterByBoolMask_6.in, mask=contains_2)
filterByBoolMask_10 = List.FilterByBoolMask(list=filterByBoolMask_9.in, mask=isEmpty_2)
code_block_3 = CodeBlock { ","; }
split = String.Split(str=filterByBoolMask_10.out, separator0=code_block_3)
lastItem = List.LastItem(list=split@L2)
code_block_4 = CodeBlock { "-"; }
split_2 = String.Split(str=lastItem, separator0=code_block_4)
toNumber = String.ToNumber(str=split_2)
byID = Custom[CW.Element.ByID](VARIDUniqueId=toNumber@L2)  # Gets the Revit element(s) for a list of IDs (or a single ID). Optionally retrieves elements from linked documents as well.
isNull = Object.IsNull(obj=byID)
anyFalse = Custom[CW.List.AnyFalse](VARseq=isNull)  # Returns true if any item in a list of booleans is false.
filterByBoolMask_11 = List.FilterByBoolMask(list=filterByBoolMask_8.out, mask=anyFalse)
eraser_2 = Custom[ST.Tool.Eraser](VARList=filterByBoolMask_11.out)
elements_4 = Custom[CW.SelectionSet.Elements](VARselectionSet=filterByBoolMask_11.in)
VARUnjoinElements = Input(VARUnjoinElements: bool = false)
element_geometry_fixer = Custom[Element.Geometry Fixer](VARElement=elements_4@L2, VARFullUnjoinedGeometry=VARUnjoinElements)  # Element.Geometry Fixer
flatten = List.Flatten(list=element_geometry_fixer@L3)
code_block_5 = CodeBlock { false; }
filterByBoolMask_12 = List.FilterByBoolMask(list=filterByBoolMask_10.out, mask=anyFalse)
split_3 = String.Split(str=filterByBoolMask_12.in, separator0=code_block_3)
code_block_6 = CodeBlock { "X1"; ":"; "X2"; '\'; }
replace = String.Replace(str=split_3, searchFor=code_block_6.out0, replaceWith=code_block_6.out1)
replace_2 = String.Replace(str=replace, searchFor=code_block_6.out2, replaceWith=code_block_6.out3)
python_script = Python(IN[0]=replace_2)
# ---------- python_script.python (28 lines) ----------
import clr
clr.AddReference('ProtoGeometry')
from Autodesk.DesignScript.Geometry import *
#The inputs to this node will be stored as a list in the IN variables.
dataEnteringNode = IN

inside = UnwrapElement(IN[0])

result = []

for each in inside:
	tmplist = []
	for e in each:
		try:
			tmplist.append(int(e))
		except:
			try:
				if e == "f":
					tmplist.append(False)
				elif e == "t":
					tmplist.append(True)
				else:
					tmplist.append(e)
			except:
				pass
	result.append(tmplist)
#Assign your output to the OUT variable.
OUT = result
# ----------------------------------------
transpose = List.Transpose(lists=python_script)
code_block_7 = CodeBlock { 2; }
dropItems = List.DropItems(list=transpose, amount=code_block_7)
code_block_8 = CodeBlock(a=dropItems) { a[0]; a[1]; a[2]; a[3]; a[4]; }
family_category = Categories("OST_Mass")
VARCustomFamilyTemplate = Input(VARCustomFamilyTemplate: var[]..[])
VARConceptualMassTemplate = Input(VARConceptualMassTemplate: var[]..[])
count = List.Count(list=python_script)
cycle = List.Cycle(list=VARConceptualMassTemplate, amount=count)
scopeIf = Custom[CW.ScopeIf+](VARtest=VARCustomFamilyTemplate, VARtrue=cycle, VARfalse=code_block_8.out3)  # A (hopefully) more robust implementation of ScopeIf. Tests a single boolean and returns a value accordingly.
k_family_insert = Custom[K-Family Insert](VARGeometryorSAT=flatten, VARAvoidConfilct=code_block_5, VARFamilyName=code_block_8.out1, VARFamilyNumber=code_block_8.out2, VARFamilyCategory=family_category, VARFamilyTemplatePath=scopeIf, VARSelfOrigin=code_block_5, lacing=Longest)  # K-Family Insert
VARFamily = Output(k_family_insert.VARFamilyInstancesOrImportSymbols)
flatten_2 = List.Flatten(list=flatten)
code_block_9 = CodeBlock { true; }
setPinnedStatus = Custom[RH.Element.SetPinnedStatus](VARelement=flatten_2, VARBool=code_block_9)  # Will set the element to either pinned or not pinned. True is pinned, false is unpinned. For multiple elements use List.Map
VARElement = Output(setPinnedStatus)
