# Dynamo custom node Family Create Parameter.dyf (Dynamo 2.13.1.3887)
# category: Synthesize.Automate.Family
# Family Create Parameter
# packages: Synthesize toolkit 12.6.3

VARName = Input(VARName: var[]..[])
turnIntoList = Custom[CW.TurnIntoList](VARunknownItem=VARName)  # package Synthesize toolkit; Turns an element (or a nested list) into a flat list
VARParameterType = Input(VARParameterType: var[]..[])
VARParameterGroup = Input(VARParameterGroup: var[]..[])
VARIsInstance = Input(VARIsInstance: var[]..[])
python_script = Python(IN[0]=turnIntoList, IN[1]=VARParameterType, IN[2]=VARParameterGroup, IN[3]=VARIsInstance)  # IronPython2
# ---------- python_script.python (83 lines) ----------
# Enable Python support and load DesignScript library
# IMPORTANT : ALL DYNAMO DESIGN SCRIPT NODES ARE AS (dg)
import clr
clr.AddReference('ProtoGeometry')
from Autodesk.DesignScript import Geometry as dg

# EXTENSION Enable ToDSType
clr.AddReference('RevitNodes')
import Revit
clr.ImportExtensions(Revit.Elements)

# Enable Revit Elements
from Revit.Elements import *

# EXTENSION Enable Geometry Conversion Methods
clr.ImportExtensions(Revit.GeometryConversion)

# Enable Revit API
clr.AddReference('RevitAPI')
from Autodesk.Revit.DB import *

# Enable DocumentManager and TransactionManager
clr.AddReference('RevitServices')
from RevitServices.Persistence import DocumentManager
from RevitServices.Transactions import TransactionManager

# Enable ICollection List Translate
clr.AddReference("System")
import System.Collections.Generic
from System.Collections.Generic import List

dataEnteringNode = IN
# Use UnwrapElement(IN[0]) When Translating From Dynamo to Revit

# Choose The Current Document
doc = DocumentManager.Instance.CurrentDBDocument
uidoc = DocumentManager.Instance.CurrentUIApplication.ActiveUIDocument
uiapp = DocumentManager.Instance.CurrentUIApplication
app = uiapp.Application

if int(DocumentManager.Instance.CurrentUIApplication.Application.VersionNumber) < 2022:
	oldrevit = True
else:
	oldrevit = False

if int(DocumentManager.Instance.CurrentUIApplication.Application.VersionNumber) < 2022:
	allSpecsNames = []
else:
	allSpecs = SpecUtils.GetAllSpecs()
	allSpecsNames = []
	for spec in allSpecs:
		allSpecsNames.append(LabelUtils.GetLabelForSpec(spec))

def getSpec(specName):
	indexOf = allSpecsNames.IndexOf(specName)
	if indexOf != -1:
		return allSpecs[indexOf]
	return None

# Create Empty List

para_Name = IN[0]
IsInstance = IN[3]
result = []
if oldrevit:
	exec("para_Type = ParameterType.%s" % IN[1])
	exec("param_Group = BuiltInParameterGroup.%s" % IN[2])
else:
	para_Type = getSpec(IN[1].ToString()[:-1].split("Name = ")[-1])
	IN[2] = IN[2].ToString()[:-1].split("Name = ")[-1]
	exec("param_Group = GroupTypeId.%s" % IN[2]) 

# Start a Transaction with Current Document (doc)
TransactionManager.Instance.EnsureInTransaction(doc)

for each in para_Name:
	result.append(doc.FamilyManager.AddParameter(each,param_Group,para_Type,IsInstance))

# End the Transaction with Current Document ()
TransactionManager.Instance.TransactionTaskDone()

# Assign your output to the OUT variable.
OUT = result
# ----------------------------------------
VARResult = Output(python_script)
