# Dynamo custom node Family Refine Levels and Offset.dyf (Dynamo 2.1.0.7500)
# category: Synthesize.Automate.Family
# Family Refine Levels and Offset

code_block = CodeBlock { 1; }
VARSetOffsetParameter = Input(VARSetOffsetParameter: var[]..[])
VARRoundingFix = Input(VARRoundingFix: var[]..[])
VARElementsLocationMethod = Input(VARElementsLocationMethod: var[]..[] = FalseBoundingBoxMethod = True;)
code_block_2 = CodeBlock { null; false; }
VARElementstoWorkon = Input(VARElementstoWorkon: var[]..[])
code_block_3 = CodeBlock { false; }
clean = List.Clean(list=VARElementstoWorkon, preserveIndices=code_block_3)
flatten = List.Flatten(list=clean)
scopeIf = Custom[CW.ScopeIf+](VARtest=VARElementsLocationMethod, VARtrue=code_block_2.out0, VARfalse=flatten)  # A (hopefully) more robust implementation of ScopeIf. Tests a single boolean and returns a value accordingly.
code_block_4 = CodeBlock { false; }
clean_2 = List.Clean(list=scopeIf, preserveIndices=code_block_4)
location = Custom[CW.Element.Location](VARelement=clean_2)  # Returns the location of an element as an XYZ (or if it's line-based the start and end point of the line), along with some booleans to help filtering the results. Use this for some element types (e.g. walls or lines) that do not work with the built-in Get Family Instance Location node.
scopeIf_2 = Custom[CW.ScopeIf+](VARtest=VARElementsLocationMethod, VARtrue=flatten, VARfalse=code_block_2.out0)
clean_3 = List.Clean(list=scopeIf_2, preserveIndices=code_block_2.out1)
boundingBox = Element.BoundingBox(element=clean_3)
maxPoint = BoundingBox.MaxPoint(boundingBox=boundingBox)
minPoint = BoundingBox.MinPoint(boundingBox=boundingBox)
byStartPointEndPoint = Line.ByStartPointEndPoint(startPoint=maxPoint, endPoint=minPoint)
code_block_5 = CodeBlock { 0.5; }
pointAtParameter = Curve.PointAtParameter(curve=byStartPointEndPoint, param=code_block_5)
create = List.Create(item0=location.VARpoints, item1=pointAtParameter)
code_block_6 = CodeBlock { false; }
clean_4 = List.Clean(list=create, preserveIndices=code_block_6)
flatten_2 = List.Flatten(list=clean_4)
flatten_3 = List.Flatten(list=flatten_2)
Z = Point.Z(point=flatten_3)
VARRounding = Input(VARRounding: var[]..[])
roundToPrecision = Custom[CW.Math.RoundToPrecision](VARdbl=Z, VARprecision=VARRounding)  # Rounds a number to a specified precision
scopeIf_3 = Custom[CW.ScopeIf+](VARtest=VARRoundingFix, VARtrue=roundToPrecision, VARfalse=Z)
VARLevels = Input(VARLevels: var[]..[])
code_block_7 = CodeBlock { "Level"; }
byClassName = Custom[SP.Filter.ByClassName](VARobject=VARLevels, VARclassName=code_block_7)  # Filters a list of objects by the object's class name. Note that Dynamo elements belong to different classes than their Revit counterparts. Use the Object.Class node to check an object's class.
projectElevation = Level.ProjectElevation()  # unwired: level
sortByFunction = List.SortByFunction(list=byClassName.VARin, func=projectElevation)
count = List.Count(list=flatten_3)
cycle = List.Cycle(list=sortByFunction, amount=count)
count_2 = List.Count(list=sortByFunction)
chop = List.Chop(list=cycle, lengths=count_2)
code_block_8 = CodeBlock { 1; }
chop_2 = List.Chop(list=sortByFunction, lengths=code_block_8)
plane = Custom[CW.Level.Plane](VARlevel=chop_2)  # Retrieves the plane of a given level
boundingBox_2 = Geometry.BoundingBox(geometry=plane)
flatten_4 = List.Flatten(list=boundingBox_2)
minPoint_2 = BoundingBox.MinPoint(boundingBox=flatten_4)
maxPoint_2 = BoundingBox.MaxPoint(boundingBox=flatten_4)
X = Point.X(point=maxPoint_2)
VARFixFactorDependsofProjectUnits1Formet = Input(VARFixFactorDependsofProjectUnits1Formetersforexampleand100forCentimeters: var[]..[])
mul = X * VARFixFactorDependsofProjectUnits1Formet
Y = Point.Y(point=maxPoint_2)
mul_2 = Y * VARFixFactorDependsofProjectUnits1Formet
projectElevation_2 = Level.ProjectElevation(level=sortByFunction)
code_block_9 = CodeBlock { -1; }
shiftIndices = List.ShiftIndices(list=projectElevation_2, amount=code_block_9)
getKeys = GetKeys(list=shiftIndices)
lastItem = List.LastItem(list=getKeys)
maximumItem = List.MaximumItem(list=shiftIndices)
code_block_10 = CodeBlock { 2; }
mul_3 = maximumItem * code_block_10
replaceItemAtIndex = List.ReplaceItemAtIndex(list=shiftIndices, index=lastItem, item=mul_3)
dm_fix_point_bycoordinates_range = Custom[DM.Fix Point.ByCoordinates Range](VARx=mul, VARy=mul_2, VARz=replaceItemAtIndex)  # Dummy Node to fix the modelling range warning
byCorners = BoundingBox.ByCorners(min=minPoint_2, max=dm_fix_point_bycoordinates_range)
contains = BoundingBox.Contains(boundingBox=byCorners, point=flatten_3@L1)
filterByBoolMask = List.FilterByBoolMask(list=chop, mask=contains)
python_empty_2_null = Custom[Python Empty 2 Null](VARIN=filterByBoolMask.in)  # Python Null 2 Empty
code_block_11 = CodeBlock { null; }
replaceEmptyLists = Custom[CW.List.ReplaceEmptyLists](VARseq=python_empty_2_null, VARReplacement=code_block_11)  # Replaces all empty lists within a given list with a substitute
rank = List.Rank(list=replaceEmptyLists)
normalizeDepth = List.NormalizeDepth(list=replaceEmptyLists, rank=rank)
code_block_12 = CodeBlock { 1; }
chop_3 = List.Chop(list=normalizeDepth, lengths=code_block_12)
flatten_5 = List.Flatten(list=chop_3@L2)
projectElevation_3 = Level.ProjectElevation()  # unwired: level
sortByFunction_2 = List.SortByFunction(list=flatten_5@L2, func=projectElevation_3)
lastItem_2 = List.LastItem(list=sortByFunction_2@L2)
bk_find_nearest_revit_level_for = Custom[BK.Find Nearest Revit Level for a Given Z value](VARzvalue=Z@L1)
flatten_6 = List.Flatten(list=bk_find_nearest_revit_level_for)
isNull = Object.IsNull()  # unwired: obj
replaceByCondition = Replace(item=lastItem_2, replaceWith=flatten_6, condition=isNull)
flatten_7 = List.Flatten(list=replaceByCondition)
projectElevation_4 = Level.ProjectElevation(level=flatten_7)
sub = scopeIf_3 - projectElevation_4
code_block_13 = CodeBlock { null; false; }
scopeIf_4 = Custom[CW.ScopeIf+](VARtest=VARSetOffsetParameter, VARtrue=sub, VARfalse=code_block_13.out0)
clean_5 = List.Clean(list=scopeIf_4, preserveIndices=code_block_13.out1)
VARElevationsSet = Output(clean_5)
VARLevelsSet = Output(flatten_7)
VARElementsSelected = Output(flatten)
VARLevelParameterName = Input(VARLevelParameterName: var[]..[])
setParameterByName = Element.SetParameterByName(element=flatten, parameterName=VARLevelParameterName, value=flatten_7)
VAROffsetParameterName = Input(VAROffsetParameterName: var[]..[])
setParameterByName_2 = Element.SetParameterByName(element=flatten, parameterName=VAROffsetParameterName, value=clean_5)
create_2 = List.Create(item0=setParameterByName, item1=setParameterByName_2)
code_block_14 = CodeBlock { false; }
clean_6 = List.Clean(list=create_2, preserveIndices=code_block_14)
flatten_8 = List.Flatten(list=clean_6)
VARElements = Output(flatten_8)
VARSelectedLevels = Output(sortByFunction)
