# Dynamo custom node Family Set Formula Parameter.dyf (Dynamo 2.1.0.7500)
# category: Synthesize.Automate.Family
# Family Set Formula Parameter

VARParameters = Input(VARParameters: var[]..[])
VARFormula = Input(VARFormula: var[]..[])
python_script = Python(IN[0]=VARParameters, IN[1]=VARFormula)
# ---------- python_script.python (57 lines) ----------
# Enable Python support and load DesignScript library
# IMPORTANT : ALL DYNAMO DESIGN SCRIPT NODES ARE AS (dg)
import clr
clr.AddReference('ProtoGeometry')
from Autodesk.DesignScript import Geometry as dg

# EXTENSION Enable ToDSType
clr.AddReference('RevitNodes')
import Revit
clr.ImportExtensions(Revit.Elements)

# Enable Revit Elements
from Revit.Elements import *

# EXTENSION Enable Geometry Conversion Methods
clr.ImportExtensions(Revit.GeometryConversion)

# Enable Revit API
clr.AddReference('RevitAPI')
from Autodesk.Revit.DB import *

# Enable DocumentManager and TransactionManager
clr.AddReference('RevitServices')
from RevitServices.Persistence import DocumentManager
from RevitServices.Transactions import TransactionManager

# Enable ICollection List Translate
clr.AddReference("System")
import System.Collections.Generic
from System.Collections.Generic import List

dataEnteringNode = IN
# Use UnwrapElement(IN[0]) When Translating From Dynamo to Revit

# Choose The Current Document
doc = DocumentManager.Instance.CurrentDBDocument
uidoc = DocumentManager.Instance.CurrentUIApplication.ActiveUIDocument
uiapp = DocumentManager.Instance.CurrentUIApplication
app = uiapp.Application

# Create Empty List

param = IN[0] 
formula = IN[1]
result = []
# Start a Transaction with Current Document (doc)
TransactionManager.Instance.EnsureInTransaction(doc)

for each in param:
	result.append(doc.FamilyManager.SetFormula(each,formula))


# End the Transaction with Current Document ()
TransactionManager.Instance.TransactionTaskDone()

# Assign your output to the OUT variable.
OUT = result
# ----------------------------------------
VARResult = Output(python_script)
