# Dynamo custom node Family Smart Rotation.dyf (Dynamo 2.1.0.7500)
# category: Synthesize.Automate.Family
# Family Smart Rotation

VARFamilyInstance = Input(VARFamilyInstance: var[]..[])
VARRandomizeRotaions = Input(VARRandomizeRotaions: var[]..[])
VARAdditiveAddsRotationtoExistedValue = Input(VARAdditiveAddsRotationtoExistedValue: var[]..[])
mod_get_element_rotation = Custom[MOD.Get Element Rotation](VARFamInstance=VARFamilyInstance@L1)  # Get the rotation of a family instance whose location is a point.
flatten = List.Flatten(list=mod_get_element_rotation.VARRotation)
VARMinimumRnadomRotationAngleUsefulWhenR = Input(VARMinimumRnadomRotationAngleUsefulWhenRandomizeRotationsisActivated: var[]..[])
count = List.Count(list=VARFamilyInstance)
cycle = List.Cycle(list=VARMinimumRnadomRotationAngleUsefulWhenR, amount=count)
VARMaximumRandomRotationAngleUsefulWhenR = Input(VARMaximumRandomRotationAngleUsefulWhenRandomizeRotationsisActivated: var[]..[])
count_2 = List.Count(list=VARFamilyInstance)
cycle_2 = List.Cycle(list=VARMaximumRandomRotationAngleUsefulWhenR, amount=count_2)
random = Math.Random(value1=cycle, value2=cycle_2)
flatten_2 = List.Flatten(list=random)
add = flatten + flatten_2
scopeIf = Custom[CW.ScopeIf+](VARtest=VARAdditiveAddsRotationtoExistedValue, VARtrue=add, VARfalse=flatten_2)  # A (hopefully) more robust implementation of ScopeIf. Tests a single boolean and returns a value accordingly.
VARDegree = Input(VARDegree: var[]..[])
cycle_3 = List.Cycle(list=VARDegree, amount=count)
add_2 = flatten + cycle_3
scopeIf_2 = Custom[CW.ScopeIf+](VARtest=VARAdditiveAddsRotationtoExistedValue, VARtrue=add_2, VARfalse=cycle_3)
scopeIf_3 = Custom[CW.ScopeIf+](VARtest=VARRandomizeRotaions, VARtrue=scopeIf, VARfalse=scopeIf_2)
setRotation = FamilyInstance.SetRotation(familyInstance=VARFamilyInstance, degree=scopeIf_3)
location = FamilyInstance.Location(familyInstance=VARFamilyInstance)
setLocation = Element.SetLocation(element=setRotation, geometry=location)
VARvoid = Output(setLocation)
