# Dynamo custom node Family and Type Selector.dyf (Dynamo 2.1.0.7500)
# category: Synthesize.Automate.Select
# Family and Type Selector

VAROnlyInActiveView = Input(VAROnlyInActiveView: var[]..[])
python_all_elements_in_active = Custom[Python All Elements In Active View]()  # Python All Elements In Active View
VARAllElementsofFamilyNameAlltypes = Input(VARAllElementsofFamilyNameAlltypes: var[]..[])
VARFamilyName = Input(VARFamilyName: var[]..[])
code_block = CodeBlock { "*"; ""; }
contains = String.Contains(str=VARFamilyName, searchFor=code_block.out0)
element_types = ElementTypes("FamilySymbol")
all_elements_of_type = ElementsOfType(element_type=element_types)
family = FamilyType.Family(familyType=all_elements_of_type)
name = Family.Name(family=family)
empty = List.Empty()
scopeIf = Custom[CW.ScopeIf+](VARtest=contains, VARtrue=VARFamilyName, VARfalse=empty)  # A (hopefully) more robust implementation of ScopeIf. Tests a single boolean and returns a value accordingly.
replace = String.Replace(str=scopeIf, searchFor=code_block.out0, replaceWith=code_block.out1)
contains_2 = String.Contains(str=name, searchFor=replace)
filterByBoolMask = List.FilterByBoolMask(list=name, mask=contains_2)
uniqueItems = List.UniqueItems(list=filterByBoolMask.in)
sort = List.Sort(list=uniqueItems)
scopeIf_2 = Custom[CW.ScopeIf+](VARtest=contains, VARtrue=empty, VARfalse=VARFamilyName)
VARSeparationSymbol = Input(VARSeparationSymbol: var[]..[])
split = String.Split(str=scopeIf_2, separator0=VARSeparationSymbol)
scopeIf_3 = Custom[CW.ScopeIf+](VARtest=contains, VARtrue=sort, VARfalse=split)
trimWhitespace = String.TrimWhitespace(str=scopeIf_3)
byName = Family.ByName(name=trimWhitespace)
types = Family.Types(family=byName)
VARSpecificTypeNamesSeparatebySymbol = Input(VARSpecificTypeNamesSeparatebySymbol: var[]..[])
split_2 = String.Split(str=VARSpecificTypeNamesSeparatebySymbol, separator0=VARSeparationSymbol)
trimWhitespace_2 = String.TrimWhitespace(str=split_2)
name_2 = FamilyType.Name(familyType=types)
contains_3 = List.Contains(list=trimWhitespace_2, item=name_2@@L1)
filterByBoolMask_2 = List.FilterByBoolMask(list=types, mask=contains_3)
python_empty_2_null = Custom[Python Empty 2 Null](VARIN=filterByBoolMask_2.in)  # Python Null 2 Empty
scopeIf_4 = Custom[CW.ScopeIf+](VARtest=VARAllElementsofFamilyNameAlltypes, VARtrue=types, VARfalse=python_empty_2_null)
code_block_2 = CodeBlock { false; }
clean = List.Clean(list=scopeIf_4, preserveIndices=code_block_2)
flatten = List.Flatten(list=clean)
all_elements_of_family_type = ElementsOfFamilyType(Family_Type=flatten)
code_block_3 = CodeBlock { false; }
clean_2 = List.Clean(list=all_elements_of_family_type, preserveIndices=code_block_3)
flatten_2 = List.Flatten(list=clean_2)
python_script = Python(IN[0]=VAROnlyInActiveView, IN[1]=python_all_elements_in_active, IN[2]=flatten_2)
# ---------- python_script.python (14 lines) ----------
import clr
clr.AddReference('ProtoGeometry')
from Autodesk.DesignScript.Geometry import *
#The inputs to this node will be stored as a list in the IN variables.
dataEnteringNode = IN

active = IN[0]
a = IN[1]
b = IN[2]

if active:
	OUT = [x for x in a if x in b]
else:
	OUT = b
# ----------------------------------------
VARElements = Output(python_script)
VARFamilyTypesList = Output(scopeIf_4)
VARFamilyNames = Output(trimWhitespace)
