# Dynamo custom node Fetch Whole Body.dyf (Dynamo 2.1.0.7500)
# category: Synthesize.Automate.Surface
# Fetch Whole Body

VARFetchorNot = Input(VARFetchorNot: var[]..[])
VARSurfaces = Input(VARSurfaces: var[]..[])
empty = List.Empty()
scopeIf = Custom[CW.ScopeIf+](VARtest=VARFetchorNot, VARtrue=VARSurfaces, VARfalse=empty)  # A (hopefully) more robust implementation of ScopeIf. Tests a single boolean and returns a value accordingly.
fromDynamoSurface = Custom[CW.Element.FromDynamoSurface](VARDynamoSurface=scopeIf)  # Returns the underlying Revit element of a given face
flatten = List.Flatten(list=fromDynamoSurface)
get_element_from_divided_surface = Custom[Get Element From Divided Surface](VARDividedSurfaces=flatten)  # Get Element From Divided Surface
uniqueItems = List.UniqueItems(list=get_element_from_divided_surface)
element_geometry_fixer = Custom[Element.Geometry Fixer](VARElement=uniqueItems)  # Element.Geometry Fixer
explode = Geometry.Explode(geometry=element_geometry_fixer)
flatten_2 = List.Flatten(list=explode)
code_block = CodeBlock { 1; }
chop = List.Chop(list=flatten_2, lengths=code_block)
scopeIf_2 = Custom[CW.ScopeIf+](VARtest=VARFetchorNot, VARtrue=chop, VARfalse=VARSurfaces)
code_block_2 = CodeBlock { false; }
clean = List.Clean(list=scopeIf_2, preserveIndices=code_block_2)
VARSurfaces_2 = Output(clean)  # "VARSurfaces"
