# Dynamo custom node Filter Transparent Materials.dyf (Dynamo 2.1.0.7500)
# category: Synthesize.Automate.Material
# Filter Transparent Materials

VARMaterials = Input(VARMaterials: var[]..[])
python_script = Python(IN[0]=VARMaterials)
# ---------- python_script.python (67 lines) ----------
# Enable Python support and load DesignScript library
# IMPORTANT : ALL DYNAMO DESIGN SCRIPT NODES ARE AS (dg)
import clr
clr.AddReference('ProtoGeometry')
from Autodesk.DesignScript import Geometry as dg

# EXTENSION Enable ToDSType
clr.AddReference('RevitNodes')
import Revit
clr.ImportExtensions(Revit.Elements)

# Enable Revit Elements
from Revit.Elements import *

# EXTENSION Enable Geometry Conversion Methods
clr.ImportExtensions(Revit.GeometryConversion)

# Enable Revit API
clr.AddReference('RevitAPI')
from Autodesk.Revit.DB import *

# Enable DocumentManager and TransactionManager
clr.AddReference('RevitServices')
from RevitServices.Persistence import DocumentManager
from RevitServices.Transactions import TransactionManager

# Enable ICollection List Translate
clr.AddReference("System")
import System.Collections.Generic
from System.Collections.Generic import List

dataEnteringNode = IN
# Use UnwrapElement(IN[0]) When Translating From Dynamo to Revit
mats = UnwrapElement(IN[0])

# Choose The Current Document
doc = DocumentManager.Instance.CurrentDBDocument
uidoc = DocumentManager.Instance.CurrentUIApplication.ActiveUIDocument
uiapp = DocumentManager.Instance.CurrentUIApplication
app = uiapp.Application

includedmats = []
for m in mats:
	try:
		renasset = doc.GetElement(m.AppearanceAssetId).GetRenderingAsset()
		try:
			renassetname = renasset.FindByName("BaseSchema").Value
			if renassetname == "GenericSchema":
				if renasset.FindByName("generic_transparency").Value > 0:
					includedmats.append(m)
					continue
			if renassetname == "PrismTransparentSchema" or renassetname == "GlazingSchema" or renassetname == "SolidGlassSchema" or renassetname == "WaterSchema":
				includedmats.append(m)
				continue
		except:
			try:
				renassetname = renasset.FindByName("category").Value.lower()
				if "glass" in renassetname:
					includedmats.append(m)
					continue
			except:
				pass
	except: pass
	if m.Transparency > 0:
		includedmats.append(m)

OUT = includedmats
# ----------------------------------------
VARMaterials_2 = Output(python_script)  # "VARMaterials"
