# Dynamo custom node Floor Opennings Prepare.dyf (Dynamo 2.1.0.7500)
# category: Synthesize.Automate.Floors
# Floor Opennings Prepare

VARJoinedCurves = Input(VARJoinedCurves: var[]..[])
byPatch = Surface.ByPatch(closedCurve=VARJoinedCurves)
isNull = Object.IsNull(obj=byPatch)
filterByBoolMask = List.FilterByBoolMask(list=VARJoinedCurves, mask=isNull)
filterByBoolMask_2 = List.FilterByBoolMask(list=byPatch, mask=isNull)
count = List.Count(list=filterByBoolMask_2.out)
ofRepeatedItem = List.OfRepeatedItem(item=filterByBoolMask.out, amount=count)
doesIntersect = Geometry.DoesIntersect(geometry=filterByBoolMask_2.out@L1, other=filterByBoolMask_2.out)
filterByBoolMask_3 = List.FilterByBoolMask(list=ofRepeatedItem, mask=doesIntersect)
ofRepeatedItem_2 = List.OfRepeatedItem(item=filterByBoolMask_2.out, amount=count)
filterByBoolMask_4 = List.FilterByBoolMask(list=ofRepeatedItem_2, mask=doesIntersect)
area = Surface.Area(surface=filterByBoolMask_4.in)
maximumItem = List.MaximumItem(list=area)
eq = area == maximumItem
filterByBoolMask_5 = List.FilterByBoolMask(list=filterByBoolMask_3.in, mask=eq)
firstItem = List.FirstItem(list=filterByBoolMask_5.in@L2)
isEmpty = List.IsEmpty(list=filterByBoolMask_5.out@L2)
filterByBoolMask_6 = List.FilterByBoolMask(list=firstItem, mask=isEmpty)
openning_hosts_curves = Watch(filterByBoolMask_6.out)
al_duplicate_item_indices = Custom[AL.Duplicate Item Indices](VARList=openning_hosts_curves)  # Searches an input list for duplicate entries and lists their index numbers. Couple with Get From List to delete duplicates from a list.
itemAtIndex = Custom[SP.List.ItemAtIndex+](VARlist=openning_hosts_curves, VARindex=al_duplicate_item_indices.VARUniqueIndices)  # Identical to the built in node but works with negative indices
VAROpenningHostsCurves = Output(itemAtIndex)
non_openning_hosts_curves = Watch(filterByBoolMask_6.in)
create = List.Create(item0=non_openning_hosts_curves, item1=filterByBoolMask.in)
code_block = CodeBlock { false; }
clean = List.Clean(list=create, preserveIndices=code_block)
flatten = List.Flatten(list=clean)
VARNonOpenningHostsCurves = Output(flatten)
filterByBoolMask_7 = List.FilterByBoolMask(list=filterByBoolMask_5.out, mask=isEmpty)
curves = PolyCurve.Curves(polyCurve=filterByBoolMask_7.out)
openning_curves = Watch(curves)
flatten_2 = List.Flatten(list=openning_curves@L2)
uniqueItems = List.UniqueItems(list=flatten_2)
byJoinedCurves = PolyCurve.ByJoinedCurves(curves=uniqueItems)
byPatch_2 = Surface.ByPatch(closedCurve=itemAtIndex)
count_2 = List.Count(list=byPatch_2)
ofRepeatedItem_3 = List.OfRepeatedItem(item=byJoinedCurves, amount=count_2)
byPatch_3 = Surface.ByPatch(closedCurve=byJoinedCurves)
flatten_3 = List.Flatten(list=byPatch_3)
doesIntersect_2 = Geometry.DoesIntersect(geometry=byPatch_2@L1, other=flatten_3)
filterByBoolMask_8 = List.FilterByBoolMask(list=ofRepeatedItem_3, mask=doesIntersect_2)
curves_2 = PolyCurve.Curves(polyCurve=filterByBoolMask_8.in)
VAROpenningCurves = Output(curves_2)
