# Dynamo custom node Floors By Subregion.dyf (Dynamo 2.1.0.7500)
# category: Synthesize.Automate.Floors
# Floors By Subregion

VARSubregions = Input(VARSubregions: var[]..[])
VARFloorType = Input(VARFloorType: var[]..[])
VARCreatePads = Input(VARCreatePads: bool = false)
VARFloorLevel = Input(VARFloorLevel: var = null)
VARPadLevel = Input(VARPadLevel: var = null)
VARTollerance = Input(VARTollerance: double = 0.001)
python_script = Python(IN[0]=VARSubregions, IN[1]=VARFloorType, IN[2]=VARCreatePads, IN[3]=VARFloorLevel, IN[4]=VARPadLevel, IN[5]=VARTollerance)
# ---------- python_script.python (241 lines) ----------
import clr
clr.AddReference('ProtoGeometry')
from Autodesk.DesignScript import Geometry as dg
clr.AddReference('RevitNodes')
import Revit
clr.AddReference('RevitAPI')
from Autodesk.Revit.DB import *
clr.AddReference('RevitServices')
from RevitServices.Persistence import DocumentManager
from RevitServices.Transactions import TransactionManager
clr.AddReference("RevitAPIUI")
from Autodesk.Revit.UI import TaskDialog
clr.ImportExtensions(Revit.GeometryConversion)
import math

class WarnSwallowSimple(IFailuresPreprocessor):
	def PreprocessFailures(self, failuresAccessor):
		failuresAccessor.DeleteAllWarnings()
		return FailureProcessingResult.Continue

def PointsEqual(pt1, pt2):
	tolerance = 0.00001
	if (math.fabs(pt1.X - pt2.X) < tolerance and
	    math.fabs(pt1.Y - pt2.Y) < tolerance and
	    math.fabs(pt1.Z - pt2.Z) < tolerance):
		return True
	else:
		return False

def tolist(obj1):
	if hasattr(obj1,'__iter__'): return obj1
	else: return [obj1]

def flatten(x):
    result = []
    for el in x:
        if hasattr(el, "__iter__") and not isinstance(el, basestring):
            result.extend(flatten(el))
        else:
            result.append(el)
    return result

def defaultpadtype(doc):
	try:
		defaultpad = BuildingPadType.CreateDefault(doc)
	except:
		defaultpad = FilteredElementCollector(doc).OfCategory(BuiltInCategory.OST_BuildingPad).WhereElementIsElementType().ToElements()[0]
	return defaultpad

def hideEdges(doc,isroof):
	if isroof:
		floorcat = doc.Settings.Categories.get_Item(BuiltInCategory.OST_Roofs).SubCategories
	else:
		floorcat = doc.Settings.Categories.get_Item(BuiltInCategory.OST_Floors).SubCategories
	for f in floorcat:
		if f.Name == "Interior Edges":
			wantedsub = f
			break
	doc.ActiveView.SetCategoryHidden(wantedsub.Id,True)
	return True

subregions = UnwrapElement(flatten(tolist(IN[0])))
floortype = UnwrapElement(IN[1])
createpads = IN[2]
floor_level = UnwrapElement(IN[3])
pad_level = UnwrapElement(IN[4])
tollerance = IN[5]

doc = DocumentManager.Instance.CurrentDBDocument
levels = FilteredElementCollector(doc).OfCategory(BuiltInCategory.OST_Levels).WhereElementIsNotElementType().ToElements()
floors = []
TransactionManager.Instance.ForceCloseTransaction()
trans = Transaction(doc, 'Create Floor From Subregion')
trans.Start()
warnhandle = WarnSwallowSimple()
foptions = trans.GetFailureHandlingOptions()
foptions.SetFailuresPreprocessor(warnhandle)
foptions.SetClearAfterRollback(True)
trans.SetFailureHandlingOptions(foptions)
showmsg = False

if floortype.ToString() == "Autodesk.Revit.DB.RoofType":
	isroof = True
else:
	isroof = False

for subregion in subregions:
	try:
		pivotpoint = subregion.get_BoundingBox(None).Min.Z
		elvs = []
		for l in levels:
			elvs.append(l.Elevation)
		accepted = []
		count = 0
		for e in elvs:
			if e < pivotpoint:
				accepted.append(e)
		try:
			wantedlevel = levels[elvs.IndexOf(max(accepted))]
		except:
			wantedlevel = levels[0]
		loops = subregion.AsSiteSubRegion().GetBoundary()
		carray = []
		for loop in loops:
			tmploop = CurveLoop()
			for l in loop:
				tmploop.Append(l)
			carray.append(tmploop)
		if floor_level == None:
			if int(DocumentManager.Instance.CurrentUIApplication.Application.VersionNumber) < 2022 or isroof:
				carrayOLD =  CurveArray()
				bigloop = list(loops)[0]
				if len(list(loops)) > 1:
					showmsg = True
				for lo in bigloop:
					carrayOLD.Append(lo)
				if isroof:
					floor = doc.Create.NewFootPrintRoof(carrayOLD,wantedlevel,floortype,clr.StrongBox[ModelCurveArray](ModelCurveArray()))
				else:
					floor = doc.Create.NewFloor(carrayOLD,floortype,wantedlevel,False)
			else:
				if isroof:
					floor = doc.Create.NewFootPrintRoof(carrayOLD,wantedlevel,floortype,clr.StrongBox[ModelCurveArray](ModelCurveArray()))
				else:
					floor = Floor.Create(doc,carray,floortype.Id,wantedlevel.Id)
		else:
			if int(DocumentManager.Instance.CurrentUIApplication.Application.VersionNumber) < 2022 or isroof:
				carrayOLD =  CurveArray()
				bigloop = list(loops)[0]
				if len(list(loops)) > 1:
					showmsg = True
				for lo in bigloop:
					carrayOLD.Append(lo)
				if isroof:
					floor = doc.Create.NewFootPrintRoof(carrayOLD,floor_level,floortype,clr.StrongBox[ModelCurveArray](ModelCurveArray()))
				else:
					floor = doc.Create.NewFloor(carrayOLD,floortype,floor_level,False)
			else:
				if isroof:
					floor = doc.Create.NewFootPrintRoof(carrayOLD,floor_level,floortype,clr.StrongBox[ModelCurveArray](ModelCurveArray()))
				else:
					floor = Floor.Create(doc,carray,floortype.Id,floor_level.Id)
		doc.Regenerate()
		if isroof:
			levelelv = doc.GetElement(floor.LookupParameter("Base Level").AsElementId()).Elevation
			floor.LookupParameter("Base Offset From Level").Set(-1.0*floortype.LookupParameter("Default Thickness").AsDouble())
			offsetelv = floor.LookupParameter("Base Offset From Level").AsDouble()
		else:
			levelelv = doc.GetElement(floor.LookupParameter("Level").AsElementId()).Elevation
			offsetelv = floor.LookupParameter("Height Offset From Level").AsDouble()
		if isroof:
			bothelvs = levelelv + offsetelv + floortype.LookupParameter("Default Thickness").AsDouble()
		else:
			bothelvs = levelelv + offsetelv
		subpoints = subregion.GetPoints()
		transubpoints = []
		for sub in subpoints:
			transubpoints.append(sub.ToPoint())
		transubpoints = dg.Point.PruneDuplicates(transubpoints,tollerance)
		subpoints = []
		for tran in transubpoints:
			subpoints.append(tran.ToXyz())
		floor.SlabShapeEditor.ResetSlabShape()
		if createpads:
			floortypethickness = 0
		else:
			floortypethickness = floortype.LookupParameter("Default Thickness").AsDouble()
		pts = []
		goodzeros = []
		for p in subpoints:
			p = XYZ(p.X,p.Y,p.Z+floortypethickness)
			floor.SlabShapeEditor.DrawPoint(p)
			if round((p.Z) - bothelvs,4) == 0:
				goodzeros.append(p)
		allverts = floor.SlabShapeEditor.SlabShapeVertices
		positions = []
		poscounts = []
		tofixes = []
		needsfix = False
		poscount = 0
		newallverts = []
		for vert in allverts:
			xyzpos = vert.Position
			isgoodzero = False
			for goodzero in goodzeros:
				if PointsEqual(xyzpos,goodzero):
					isgoodzero = True
					newallverts.append([vert,isgoodzero])
					break
			if isgoodzero == False:
				newallverts.append([vert,isgoodzero])
		allverts = newallverts
		for vert in allverts:
			check = vert[1]
			vert = vert[0]
			xyzpos = vert.Position
			positions.append(xyzpos)
			z = round(xyzpos.Z - bothelvs,4)
			if z == 0 and check == False:
				tofixes.append([vert,xyzpos.ToPoint()])
				poscounts.append(poscount)
				needsfix = True
			poscount += 1
		if needsfix:
			tranned = []
			newcount = 0
			for pos in positions:
				if newcount not in poscounts:
					tranned.append(pos.ToPoint())
				newcount += 1
			for tofix in tofixes:
				vert = tofix[0]
				pt = tofix[1]
				dises = []
				for tran in tranned:
					dises.append(dg.Geometry.DistanceTo(pt,tran))
				nearestZ = tranned[dises.IndexOf(min(dises))].ToXyz().Z - bothelvs
				floor.SlabShapeEditor.ModifySubElement(vert,nearestZ)
		if createpads:
			doc.Delete(subregion.Id)
			if pad_level == None:
				pad = Architecture.BuildingPad.Create(doc,defaultpadtype(doc).Id,wantedlevel.Id,carray)
			else:
				pad = Architecture.BuildingPad.Create(doc,defaultpadtype(doc).Id,pad_level.Id,carray)
			floors.append([floor,pad])
		else:
			floors.append(floor)
	except:
		floors.append(None)
hideEdges(doc,isroof)
trans.Commit()

if showmsg:
	if isroof:
		msg = "Multiple Loops In A Single Subregion Is Not Supported\n\nUse Topography.Subregions Separate Script to Separate Subregions If Possible."
	else:
		msg = "Multiple Loops Were Discarded\nUse Revit 2022 or Above."
	title = "AECedx - Karam"
	TaskDialog.Show(title, msg)
	
OUT = floors
# ----------------------------------------
VARFloors = Output(python_script)
