# Dynamo custom node Format Numbers.dyf (Dynamo 2.1.0.7500)
# category: Synthesize.Automate.Math
# Increase Decimals

VARNumbers = Input(VARNumbers: var[]..[])
python_script = Python(IN[0]=VARNumbers)
# ---------- python_script.python (8 lines) ----------
import clr
clr.AddReference('ProtoGeometry')
from Autodesk.DesignScript.Geometry import *
#The inputs to this node will be stored as a list in the IN variables.
num = IN[0]

#Assign your output to the OUT variable.
OUT = float(num)
# ----------------------------------------
code_block = CodeBlock { "."; "f"; }
VARDecimals = Input(VARDecimals: var[]..[])
code_block_2 = CodeBlock(a=code_block.out0, b=VARDecimals, c=code_block.out1) { a+b+c; }
python_script_2 = Python(IN[0]=python_script, IN[1]=code_block_2)
# ---------- python_script_2.python (9 lines) ----------
import clr
clr.AddReference('ProtoGeometry')
from Autodesk.DesignScript.Geometry import *
#The inputs to this node will be stored as a list in the IN variables.
num = IN[0]
dec = IN[1]

#Assign your output to the OUT variable.
OUT = format(num , dec)
# ----------------------------------------
VARString = Output(python_script_2)
