# Dynamo custom node Fractle Tree Lines.dyf (Dynamo 2.1.0.7500)
# category: Synthesize.Automate.Geometry
# Fractle Tree Lines

join = List.Join()  # unwired: list0, list1
VARInitialCurves = Input(VARInitialCurves: var[]..[])
VARBushesScale = Input(VARBushesScale: var[]..[])
VARAngleMin = Input(VARAngleMin: var[]..[])
VARAngleMax = Input(VARAngleMax: var[]..[])
join_2 = List.Join(list0=VARAngleMin, list1=VARAngleMax)
VARRepetition = Input(VARRepetition: var[]..[])
VARRandomnessMin = Input(VARRandomnessMin: var[]..[])
VARRandomnessMax = Input(VARRandomnessMax: var[]..[])
join_3 = List.Join(list0=VARRandomnessMin, list1=VARRandomnessMax)
python_script = Python(IN[0]=VARInitialCurves, IN[1]=VARBushesScale, IN[2]=join_2, IN[3]=VARRepetition, IN[4]=join_3)
# ---------- python_script.python (90 lines) ----------
# Created By Karam Baki : karam@aecedx.com
# Enable Python support and load DesignScript library
# IMPORTANT : ALL DYNAMO DESIGN SCRIPT NODES ARE AS (dg)
import clr
clr.AddReference('ProtoGeometry')
from Autodesk.DesignScript import Geometry as dg

# EXTENSION Enable ToDSType
clr.AddReference('RevitNodes')
import Revit
clr.ImportExtensions(Revit.Elements)

# Enable Revit Elements
from Revit.Elements import *

# EXTENSION Enable Geometry Conversion Methods
clr.ImportExtensions(Revit.GeometryConversion)

# Enable Revit API
clr.AddReference('RevitAPI')
from Autodesk.Revit.DB import *

# Enable DocumentManager and TransactionManager
clr.AddReference('RevitServices')
from RevitServices.Persistence import DocumentManager
from RevitServices.Transactions import TransactionManager

# Enable ICollection List Translate
clr.AddReference("System")
import System.Collections.Generic
from System.Collections.Generic import List

import sys
sys.path.append(r'C:\Program Files (x86)\IronPython 2.7\DLLs')
sys.path.append(r'C:\Program Files (x86)\IronPython 2.7\Lib')

import random

dataEnteringNode = IN
# Use UnwrapElement(IN[0]) When Translating From Dynamo to Revit
curves=UnwrapElement(IN[0])
scale=UnwrapElement(IN[1])
degrees=UnwrapElement(IN[2])
repetition=UnwrapElement(IN[3])
randomness=UnwrapElement(IN[4])
randommin = randomness[0]
randommax= randomness[1]
# Choose The Current Document
doc = DocumentManager.Instance.CurrentDBDocument
uidoc = DocumentManager.Instance.CurrentUIApplication.ActiveUIDocument
uiapp = DocumentManager.Instance.CurrentUIApplication
app = uiapp.Application

def flatten(x):
    result = []
    for el in x:
        if hasattr(el, "__iter__") and not isinstance(el, basestring):
            result.extend(flatten(el))
        else:
            result.append(el)
    return result

def tree(curve, degrees, scaleing):
	result = []
	for each in curve:
		tmplist = []
		for e in degrees:
			randomdegree = (random.uniform(randommin,randommax)*e)
			endpoint = each.EndPoint
			vector_to_rot = dg.Vector.ByTwoPoints(each.StartPoint,endpoint)
			rotvec = dg.Vector.Rotate(vector_to_rot,dg.Vector.YAxis(),randomdegree)
			scaled = each.Length * scaleing
			randomscaling = (random.uniform(randommin,randommax)*scaled)
			line = dg.Line.ByStartPointDirectionLength(endpoint,rotvec,randomscaling)
			tmplist.append(line)
		result.append(tmplist)
		result = flatten(result)
	return result

finalresult = []
finalresult.append(tree(curves,degrees,scale))

while repetition != 0:
	takecurve = finalresult[-1]
	newlines = tree(takecurve,degrees,scale)
	finalresult.append(newlines)
	repetition = repetition - 1

# Assign your output to the OUT variable.
OUT = finalresult
# ----------------------------------------
count = List.Count(list=python_script@L2)
count_2 = List.Count(list=VARInitialCurves)
div = count / count_2
chop = List.Chop(list=python_script, lengths=div, lacing=Longest)
transpose = List.Transpose(lists=chop)
flatten = List.Flatten(list=transpose@L3)
combine = List.Combine(comb=join, list1=VARInitialCurves, list2=flatten)
VARcombined = Output(combine)
