# Dynamo custom node Fusion 360 Family Import.dyf (Dynamo 2.1.0.7500)
# category: Synthesize.Automate.Fusion 360
# Fusion 360 SAT Sync

VARFlipOrientation = Input(VARFlipOrientation: var[]..[])
VARExportedSATFile = Input(VARExportedSATFile: var[]..[])
importFromSAT = Geometry.ImportFromSAT(file=VARExportedSATFile)
number = DoubleInput(1)
byCoordinates = Vector.ByCoordinates(y=number, z=number)
byOriginNormal = Plane.ByOriginNormal(normal=byCoordinates)
number_2 = DoubleInput(180)
rotate = Geometry.Rotate(geometry=importFromSAT, basePlane=byOriginNormal, degrees=number_2)
scopeIf = Custom[CW.ScopeIf+](VARtest=VARFlipOrientation, VARtrue=rotate, VARfalse=importFromSAT)  # A (hopefully) more robust implementation of ScopeIf. Tests a single boolean and returns a value accordingly.
VARXScale = Input(VARXScale: var[]..[])
VARYScale = Input(VARYScale: var[]..[])
VARZScale = Input(VARZScale: var[]..[])
scale = Geometry.Scale(geometry=scopeIf, xamount=VARXScale, yamount=VARYScale, zamount=VARZScale)
code_block = CodeBlock { true; }
dynamo_geometry_to_revit = Custom[Dynamo Geometry To Revit Compatibility](VARGeometryOrSat=scale, VARPreferImportInstance=code_block, VARReturnFailures=code_block)  # Dynamo Geometry To Revit Compatibility
VARImportInstance = Output(dynamo_geometry_to_revit)
