# Dynamo custom node Generate Lines (Helper for Smart Arcs Detection).dyf (Dynamo 2.1.0.7500)
# category: Synthesize.Automate.Lines
# Generate Lines (Helper for Smart Lines)

VARExactSameEdgeIgnoresNumberofControlPo = Input(VARExactSameEdgeIgnoresNumberofControlPointsDesiredUsefulforConvertingIntoSmartLinesHoweveritsettoTruetheLineswilltrytoJoin: var[]..[])
VARWithPointsConceptualEnvironmentOnly = Input(VARWithPointsConceptualEnvironmentOnly: var[]..[])
code_block = CodeBlock { true; }
scopeIf = Custom[CW.ScopeIf+](VARtest=VARExactSameEdgeIgnoresNumberofControlPo, VARtrue=VARWithPointsConceptualEnvironmentOnly, VARfalse=code_block)  # A (hopefully) more robust implementation of ScopeIf. Tests a single boolean and returns a value accordingly.
code_block_2 = CodeBlock { null; }
VARCurves = Input(VARCurves: var[]..[])
flatten = List.Flatten(list=VARCurves)
code_block_3 = CodeBlock { "Arc"; }
byClassName = Custom[SP.Filter.ByClassName](VARobject=flatten, VARclassName=code_block_3)  # Filters a list of objects by the object's class name. Note that Dynamo elements belong to different classes than their Revit counterparts. Use the Object.Class node to check an object's class.
flatten_2 = List.Flatten(list=byClassName.VARin)
scopeIf_2 = Custom[CW.ScopeIf+](VARtest=scopeIf, VARtrue=code_block_2, VARfalse=flatten_2)
code_block_4 = CodeBlock { false; }
clean = List.Clean(list=scopeIf_2, preserveIndices=code_block_4)
flatten_3 = List.Flatten(list=clean)
isEmpty = List.IsEmpty(list=flatten_3)
code_block_5 = CodeBlock { null; false; }
flatten_4 = List.Flatten(list=byClassName.VARout)
scopeIf_3 = Custom[CW.ScopeIf+](VARtest=isEmpty, VARtrue=code_block_5.out0, VARfalse=flatten_4)
scopeIf_4 = Custom[CW.ScopeIf+](VARtest=isEmpty, VARtrue=flatten, VARfalse=code_block_5.out0)
create = List.Create(item0=scopeIf_3, item1=scopeIf_4)
clean_2 = List.Clean(list=create, preserveIndices=code_block_5.out1)
flatten_5 = List.Flatten(list=clean_2)
VARCurves_2 = Output(flatten_5)  # "VARCurves"
count = List.Count(list=flatten_3)
VARNumberofLinesTurnedIntoArcs = Output(count)
byCurve = ModelCurve.ByCurve(curve=flatten_3)
VARModelCurves = Output(byCurve)
