# Dynamo custom node Generate Lines (Smart with Auto compatibility with Revit).dyf (Dynamo 2.1.0.7500)
# category: Synthesize.Automate.Lines
# Generate Lines (Smart with Auto compatibility with Revit)

VARNumberofControlPointsPerLine = Input(VARNumberofControlPointsPerLine: var[]..[])
code_block = CodeBlock { 0; }
code_block_2 = CodeBlock { true; }
VARWithPoints = Input(VARWithPoints: var[]..[])
code_block_3 = CodeBlock { null; }
VARFlattentoNearestLevel = Input(VARFlattentoNearestLevel: var[]..[])
VARCurves = Input(VARCurves: var[]..[])
flatten = List.Flatten(list=VARCurves)
as_polycurve_bycurves_with = Custom[AS.[&] PolyCurve.ByCurves With Failures](VARcurves=flatten)  # Create polycurves from an unordered list of curves.
flatten_2 = List.Flatten(list=as_polycurve_bycurves_with.VARpolyCurve)
isClosed = Curve.IsClosed(curve=flatten_2)
VARExactSameLineIgnoresNumberofControlPo = Input(VARExactSameLineIgnoresNumberofControlPointsDesiredUsefulforConvertingIntoSmartLines: var[]..[])
VARSplitNormalizeFactorExactSameLineMust = Input(VARSplitNormalizeFactorExactSameLineMustbeFasleWorksforClosedLoopsOnly: var[]..[])
lines_join_and_flatten = Custom[Lines Join and Flatten](VARFlattentoNearestLevel=VARFlattentoNearestLevel, VARNumberofControlPointsDesired=VARNumberofControlPointsPerLine, VARCloseCurves=isClosed, VARExactSameLineIgnoresNumberofControlPointsDesiredUsefulforConvertingIntoSmartLines=VARExactSameLineIgnoresNumberofControlPo, VARSplitNormalizeFactorExactSameLineMustbeFasleWorksforClosedLoopsOnly=VARSplitNormalizeFactorExactSameLineMust, VARCurves=flatten_2, lacing=Longest)  # Joins Lines and Flattens them to Nearest Level
flatten_3 = List.Flatten(list=lines_join_and_flatten)
isPlanar = Curve.IsPlanar(curve=flatten_3)
filterByBoolMask = List.FilterByBoolMask(list=flatten_3, mask=isPlanar)
scopeIf = Custom[CW.ScopeIf+](VARtest=VARWithPoints, VARtrue=code_block_3, VARfalse=filterByBoolMask.out)  # A (hopefully) more robust implementation of ScopeIf. Tests a single boolean and returns a value accordingly.
code_block_4 = CodeBlock { null; false; }
clean = List.Clean(list=scopeIf, preserveIndices=code_block_4.out1)
generate_lines_without_join = Custom[Generate Lines Without Join](VARNumberofControlPointsPerLine=VARNumberofControlPointsPerLine, VARExtraExtendedDistance=code_block, VARLinesWithPoints=code_block_2, VARCurves=clean@L2, lacing=Longest)  # Generate Lines
flatten_4 = List.Flatten(list=generate_lines_without_join.VARModelCurve)
count = List.Count(list=flatten_4)
VARNumberofLinesForcedToBeWithPointsUsed = Output(count)  # "VARNumberofLinesForcedToBeWithPointsUsedNumberofControlPoints"
scopeIf_2 = Custom[CW.ScopeIf+](VARtest=VARWithPoints, VARtrue=code_block_4.out1, VARfalse=isPlanar)
scopeIf_3 = Custom[CW.ScopeIf+](VARtest=scopeIf_2, VARtrue=flatten_3, VARfalse=code_block_4.out0)
clean_2 = List.Clean(list=scopeIf_3, preserveIndices=code_block_4.out1)
flatten_5 = List.Flatten(list=clean_2)
byCurve = ModelCurve.ByCurve(curve=flatten_5)
isNull = Object.IsNull(obj=byCurve)
countTrue = List.CountTrue(list=isNull)
filterByBoolMask_2 = List.FilterByBoolMask(list=flatten_5, mask=isNull)
generate_lines_without_join_2 = Custom[Generate Lines Without Join](VARNumberofControlPointsPerLine=VARNumberofControlPointsPerLine, VARExtraExtendedDistance=code_block, VARLinesWithPoints=VARWithPoints, VARCurves=filterByBoolMask_2.in@L2, lacing=Longest)
flatten_6 = List.Flatten(list=generate_lines_without_join_2.VARModelCurve)
curves = Element.Curves(element=flatten_6)
flatten_7 = List.Flatten(list=curves)
code_block_5 = CodeBlock { "Arc"; }
byClassName = Custom[SP.Filter.ByClassName](VARobject=flatten_7, VARclassName=code_block_5)  # Filters a list of objects by the object's class name. Note that Dynamo elements belong to different classes than their Revit counterparts. Use the Object.Class node to check an object's class.
count_2 = List.Count(list=byClassName.VARin)
sub = countTrue - count_2
VARNumberofLinesForcedtoBeNotExactUsedNu = Output(sub)  # "VARNumberofLinesForcedtoBeNotExactUsedNumberofControlPoints"
scopeIf_4 = Custom[CW.ScopeIf+](VARtest=VARWithPoints, VARtrue=flatten_3, VARfalse=code_block_4.out0)
clean_3 = List.Clean(list=scopeIf_4, preserveIndices=code_block_4.out1)
flatten_8 = List.Flatten(list=clean_3)
generate_lines_without_join_3 = Custom[Generate Lines Without Join](VARNumberofControlPointsPerLine=VARNumberofControlPointsPerLine, VARExtraExtendedDistance=code_block, VARLinesWithPoints=VARWithPoints, VARCurves=flatten_8@L2, lacing=Longest)
create = List.Create(item0=flatten_6, item1=generate_lines_without_join_3.VARModelCurve, item2=byCurve, item3=generate_lines_without_join.VARModelCurve, item4=flatten_4, item5=generate_lines_without_join_2.VARReferencePoints, item6=generate_lines_without_join_3.VARReferencePoints, item7=generate_lines_without_join.VARReferencePoints)
code_block_6 = CodeBlock { false; }
clean_4 = List.Clean(list=create, preserveIndices=code_block_6)
uniqueItems = List.UniqueItems(list=clean_4)
flatten_9 = List.Flatten(list=uniqueItems)
VARModelCurves = Output(flatten_9)
