# Dynamo custom node Generate Selection Filter.dyf (Dynamo 2.1.0.7500)
# category: Synthesize.Automate.Filter
# Generate Selection FIlter

VARElements = Input(VARElements: var[]..[])
flatten = List.Flatten(list=VARElements)
code_block = CodeBlock { false; }
clean = List.Clean(list=flatten, preserveIndices=code_block)
isEmpty = List.IsEmpty(list=clean)
code_block_2 = CodeBlock { null; false; }
VARCreateSelectionFilter = Input(VARCreateSelectionFilter: var[]..[])
VARFilterNametoCreate = Input(VARFilterNametoCreate: var[]..[])
code_block_3 = CodeBlock { null; }
scopeIf = Custom[CW.ScopeIf+](VARtest=VARCreateSelectionFilter, VARtrue=VARFilterNametoCreate, VARfalse=code_block_3)  # A (hopefully) more robust implementation of ScopeIf. Tests a single boolean and returns a value accordingly.
scopeIf_2 = Custom[CW.ScopeIf+](VARtest=isEmpty, VARtrue=code_block_2.out0, VARfalse=scopeIf)
clean_2 = List.Clean(list=scopeIf_2, preserveIndices=code_block_2.out1)
flatten_2 = List.Flatten(list=clean_2)
VAROverwriteExistingFilter = Input(VAROverwriteExistingFilter: var[]..[])
code_block_4 = CodeBlock { null; false; }
scopeIf_3 = Custom[CW.ScopeIf+](VARtest=VARCreateSelectionFilter, VARtrue=clean, VARfalse=code_block_4.out0)
clean_3 = List.Clean(list=scopeIf_3, preserveIndices=code_block_4.out1)
code_block_5 = CodeBlock { false; }
clean_4 = List.Clean(list=clean_3, preserveIndices=code_block_5)
code_block_6 = CodeBlock { null; false; }
scopeIf_4 = Custom[CW.ScopeIf+](VARtest=VAROverwriteExistingFilter, VARtrue=clean_4, VARfalse=code_block_6.out0)
hot_get_all_filter = Custom[HOT.Get All Filter]()  # Get all Filter
eq = hot_get_all_filter.VARName == VARFilterNametoCreate
filterByBoolMask = List.FilterByBoolMask(list=hot_get_all_filter.VARElement, mask=eq)
elements = Custom[CW.SelectionSet.Elements](VARselectionSet=filterByBoolMask.in)  # Retrieves all elements stored in a selection set
turnIntoList = Custom[CW.TurnIntoList](VARunknownItem=elements)  # Turns an element (or a nested list) into a flat list
clean_5 = List.Clean(list=turnIntoList, preserveIndices=code_block_5)
join = List.Join(list0=clean_4, list1=clean_5)
scopeIf_5 = Custom[CW.ScopeIf+](VARtest=VAROverwriteExistingFilter, VARtrue=code_block_6.out0, VARfalse=join)
create = List.Create(item0=scopeIf_4, item1=scopeIf_5)
clean_6 = List.Clean(list=create, preserveIndices=code_block_6.out1)
flatten_3 = List.Flatten(list=clean_6)
byElements = Custom[CW.SelectionSet.ByElements](VARName=flatten_2, VARelements=flatten_3)  # Creates a selection set of the given elements. Note that if a selection set of the given name already exists in the model, its contents will be replaced. Also, if the selection set is already applied as a view filter, the view filter will have to be manually updated in the visibility / graphic overrides. DO ***NOT*** USE IN AUTOMATIC MODE!
VARSelectionSet = Output(byElements.VARselectionSet)
VARElements_2 = Output(flatten_3)  # "VARElements"
VARSelectionSetId = Output(byElements.VARselectionSetId)
