# Dynamo custom node Generate T-Lines.dyf (Dynamo 2.1.0.7500)
# category: Synthesize.Automate.Lines
# Generate T-Lines

VARUGrid = Input(VARUGrid: var[]..[])
VARVGrid = Input(VARVGrid: var[]..[])
VARDrawLines = Input(VARDrawLines: var[]..[])
VARCurves = Input(VARCurves: var[]..[])
flatten = List.Flatten(list=VARCurves)
code_block = CodeBlock { 1; 0; }
VARNumberofControlPointsPerLine = Input(VARNumberofControlPointsPerLine: var[]..[])
sequence = Sequence(start=code_block.out0, amount=VARNumberofControlPointsPerLine, step=code_block.out0, lacing=Longest)
remapRange = Math.RemapRange(numbers=sequence, newMin=code_block.out1, newMax=code_block.out0)
pointAtParameter = Curve.PointAtParameter(curve=flatten@L1, param=remapRange)
byPoints = NurbsCurve.ByPoints(points=pointAtParameter)
VARExtraExtendedDistance = Input(VARExtraExtendedDistance: var[]..[])
extendStart = Curve.ExtendStart(curve=byPoints, distance=VARExtraExtendedDistance)
extendEnd = Curve.ExtendEnd(curve=extendStart, distance=VARExtraExtendedDistance)
code_block_2 = CodeBlock { null; false; }
scopeIf = Custom[CW.ScopeIf+](VARtest=VARDrawLines, VARtrue=extendEnd, VARfalse=code_block_2.out0)  # A (hopefully) more robust implementation of ScopeIf. Tests a single boolean and returns a value accordingly.
clean = List.Clean(list=scopeIf, preserveIndices=code_block_2.out1)
flatten_2 = List.Flatten(list=clean)
pointAtParameter_2 = Curve.PointAtParameter(curve=flatten_2@L1, param=remapRange)
code_block_3 = CodeBlock { false; }
clean_2 = List.Clean(list=pointAtParameter_2, preserveIndices=code_block_3)
count = List.Count(list=clean_2)
VARReferencePlaneNamePrefix = Input(VARReferencePlaneNamePrefix: var[]..[])
VARFlipReferencePlanesSide = Input(VARFlipReferencePlanesSide: var[]..[])
VARReferencePlanesOffset = Input(VARReferencePlanesOffset: var[]..[])
VARFaces = Input(VARFaces: var[]..[])
code_block_4 = CodeBlock { null; }
scopeIf_2 = Custom[CW.ScopeIf+](VARtest=VARDrawLines, VARtrue=VARFaces, VARfalse=code_block_4)
reference_plane_perpendicular_on = Custom[Reference Plane Perpendicular On Face](VARReferencePlaneNamePrefix=VARReferencePlaneNamePrefix, VARFlipReferencePlanesSide=VARFlipReferencePlanesSide, VARReferencePlanesOffset=VARReferencePlanesOffset, VARFaces=scopeIf_2)  # Reference Plane Perpendicular On Face
count_2 = List.Count(list=reference_plane_perpendicular_on)
div = count / count_2
chop = List.Chop(list=clean_2, lengths=div)
python_script = Python(IN[0]=reference_plane_perpendicular_on)
# ---------- python_script.python (45 lines) ----------
import clr
clr.AddReference('ProtoGeometry')
from Autodesk.DesignScript.Geometry import *

# Import Element wrapper extension methods
clr.AddReference("RevitNodes")
import Revit
clr.ImportExtensions(Revit.Elements)

# Import geometry conversion extension methods
clr.ImportExtensions(Revit.GeometryConversion)

# Import DocumentManager and TransactionManager
clr.AddReference("RevitServices")
import RevitServices
from RevitServices.Persistence import DocumentManager
from RevitServices.Transactions import TransactionManager

doc = DocumentManager.Instance.CurrentDBDocument
uiapp = DocumentManager.Instance.CurrentUIApplication
app = uiapp.Application

# Import RevitAPI
clr.AddReference("RevitAPI")
import Autodesk
from Autodesk.Revit.DB import *

doc = DocumentManager.Instance.CurrentDBDocument
uiapp = DocumentManager.Instance.CurrentUIApplication
app = uiapp.Application

# The inputs to this node will be stored as a list in the IN variable.
dataEnteringNode = IN

# Unwrap elements and convert geometry from Dynamo to Revit:

rPlanes = UnwrapElement(IN[0])
result = []
# Set the reference plane as the sketchplane in the active view in another transaction
TransactionManager.Instance.EnsureInTransaction(doc)
for each in rPlanes:
	result.append(SketchPlane.Create(doc,each.Id))
TransactionManager.Instance.TransactionTaskDone()

OUT = result
# ----------------------------------------
python_script_2 = Python(IN[0]=chop, IN[1]=python_script)
# ---------- python_script_2.python (73 lines) ----------
# Enable Python support and load DesignScript library
# IMPORTANT : ALL DYNAMO DESIGN SCRIPT NODES ARE AS (dg)
import clr
clr.AddReference('ProtoGeometry')
from Autodesk.DesignScript import Geometry as dg

# EXTENSION Enable ToDSType
clr.AddReference('RevitNodes')
import Revit
clr.ImportExtensions(Revit.Elements)

# Enable Revit Elements
from Revit.Elements import *

# EXTENSION Enable Geometry Conversion Methods
clr.ImportExtensions(Revit.GeometryConversion)

# Enable Revit API
clr.AddReference('RevitAPI')
from Autodesk.Revit.DB import *

# Enable DocumentManager and TransactionManager
clr.AddReference('RevitServices')
from RevitServices.Persistence import DocumentManager
from RevitServices.Transactions import TransactionManager

# Enable ICollection List Translate
clr.AddReference("System")
import System.Collections.Generic
from System.Collections.Generic import List

doc = DocumentManager.Instance.CurrentDBDocument
app = doc.Application

Pointslist = UnwrapElement(IN[0])
Sketchplanes = UnwrapElement(IN[1])
result = []
model_lines = []

TransactionManager.Instance.EnsureInTransaction(doc)

ConvertedSketchPlanes = []
for each in Sketchplanes:
	ConvertedSketchPlanes.append(each.GetPlaneReference())

dynpoints= []
refpoints= []

count = 0
for eachplane in ConvertedSketchPlanes:
	tmplist = []
	tmplist2= []
	newcount = 0
	for eachlist in Pointslist[count]:
		anothertmp = []
		parray = ReferencePointArray()
		for eachpoint in eachlist:
			eachpoint.ToXyz()
			dynpoints = PointOnPlane.NewPointOnPlane(doc,eachplane,eachpoint.ToXyz(),XYZ(0,0,1))
			dynpoints.SetPlaneReference(eachplane)
			refpoints = doc.FamilyCreate.NewReferencePoint(dynpoints)
			anothertmp.append(refpoints)
			parray.Append(refpoints)
		pcurve = doc.FamilyCreate.NewCurveByPoints(parray)
		tmplist.append(anothertmp)
		tmplist2.append(pcurve)
	result.append(tmplist)
	model_lines.append(tmplist2)
	count = count + 1		

TransactionManager.Instance.TransactionTaskDone()

OUT = result,model_lines
# ----------------------------------------
code_block_5 = CodeBlock(a=python_script_2) { a[0]; a[1]; }
clean_3 = List.Clean(list=code_block_5.out1, preserveIndices=code_block_3)
VARModelCurve = Output(clean_3)
VARLinesWithPoints = Input(VARLinesWithPoints: var[]..[])
VARReferencePoints = Output(code_block_5.out0)
VARReferencePlanes = Output(reference_plane_perpendicular_on)
