# Dynamo custom node Generate T-Sequenced Points.dyf (Dynamo 2.1.0.7500)
# category: Synthesize.Automate.Point
# Generate T-Sequenced Points

code_block = CodeBlock { ""; }
join = String.Join(separator=code_block)  # unwired: string0, string1
VARPoints = Input(VARPoints: var[]..[])
count = List.Count(list=VARPoints)
code_block_2 = CodeBlock { true; }
alphabeticalSequence = Custom[CW.List.AlphabeticalSequence](VARn=count, VARupperCase=code_block_2)  # Creates a list of the first N letters of the alphabet (where 1 = A, 2 = B, ... , 27 = AA, 28 = AB etc.).
code_block_3 = CodeBlock { 1; }
chop = List.Chop(list=alphabeticalSequence, lengths=code_block_3)
count_2 = List.Count(list=VARPoints@L2)
firstItem = List.FirstItem(list=count_2)
cycle = List.Cycle(list=chop@L2, amount=firstItem)
flatten = List.Flatten(list=cycle)
VARNumberSequenceStart = Input(VARNumberSequenceStart: var[]..[])
code_block_4 = CodeBlock { 1; }
sequence = Sequence(start=VARNumberSequenceStart, amount=firstItem, step=code_block_4, lacing=Longest)
string_from_object = FromObject(obj=sequence)
ofRepeatedItem = List.OfRepeatedItem(item=string_from_object, amount=count)
flatten_2 = List.Flatten(list=ofRepeatedItem)
combine = List.Combine(comb=join, list1=flatten, list2=flatten_2)
VARPlacePoints = Input(VARPlacePoints: var[]..[])
code_block_5 = CodeBlock { null; false; }
scopeIf = Custom[CW.ScopeIf+](VARtest=VARPlacePoints, VARtrue=VARPoints, VARfalse=code_block_5.out0)  # A (hopefully) more robust implementation of ScopeIf. Tests a single boolean and returns a value accordingly.
flatten_3 = List.Flatten(list=scopeIf)
code_block_6 = CodeBlock { false; }
clean = List.Clean(list=flatten_3, preserveIndices=code_block_6)
byPoint = ReferencePoint.ByPoint(pt=clean)
code_block_7 = CodeBlock { "Name"; }
code_block_8 = CodeBlock { 0.0001; }
count_3 = List.Count(list=flatten)
sequence_2 = Sequence(start=code_block_8, amount=count_3, step=code_block_8, lacing=Longest)
string_from_object_2 = FromObject(obj=sequence_2)
setParameterByName = Element.SetParameterByName(element=byPoint, parameterName=code_block_7, value=string_from_object_2)
passthrough = Custom[CW.Passthrough](VARpassThrough=combine, VARwaitFor=setParameterByName)  # Forces a sequential order of execution. The node wired into the output of the Passthrough node will be executed *after* the node wired into the waitFor input (e.g. important for some Revit operations). The value of the passThrough input will be passed on to the node wired into the output port of the Passthrough node.
lastItem = List.LastItem(list=passthrough)
VARLastPointName = Output(lastItem)
passthrough_2 = Custom[CW.Passthrough](VARpassThrough=byPoint, VARwaitFor=setParameterByName)
passthrough_3 = Custom[CW.Passthrough](VARpassThrough=code_block_7, VARwaitFor=setParameterByName)
setParameterByName_2 = Element.SetParameterByName(element=passthrough_2, parameterName=passthrough_3, value=passthrough)
count_4 = List.Count(list=setParameterByName_2)
VARNumberofPoints = Output(count_4)
VARReferencePoints = Output(byPoint)
VARSurface = Input(VARSurface: var[]..[])
