# Dynamo custom node Geometry Bottom Mid Point.dyf (Dynamo 2.1.0.7500)
# category: Synthesize.Automate.Geometry
# Geometry Bottom Mid Point

VARGeometries = Input(VARGeometries: var[]..[])
python_script = Python(IN[0]=VARGeometries)
# ---------- python_script.python (37 lines) ----------
import clr
clr.AddReference('ProtoGeometry')
from Autodesk.DesignScript import Geometry as dg

# To List
def tolist(obj1):
	if hasattr(obj1,'__iter__'): return obj1
	else: return [obj1]

# Detect Bottom Mid Point
def midbottompoint(geoms):
	bigbound = dg.BoundingBox.ByGeometry(geoms)
	minp = bigbound.MinPoint
	maxp = bigbound.MaxPoint
	maxpX = maxp.X
	maxpY = maxp.Y
	fixedmaxp = dg.Point.ByCoordinates(maxpX,maxpY,minp.Z)
	midP = dg.Curve.PointAtParameter(dg.Line.ByStartPointEndPoint(minp,fixedmaxp),0.5)
	return midP

# Flatten List
def flatten(x):
    result = []
    try:
    	for el in x:
        	if hasattr(el, "__iter__") and not isinstance(el, basestring):
        	    result.extend(flatten(el))
        	else:
        	    result.append(el)
    except:
    	result = x
    return result

geoms = flatten(tolist(IN[0]))

#Assign your output to the OUT variable.
OUT = midbottompoint(geoms)
# ----------------------------------------
VARBottomMidPoint = Output(python_script)
