# Dynamo custom node Geometry of Model Curves and Curve By Points.dyf (Dynamo 2.1.0.7500)
# category: Synthesize.Automate.Geometry
# Geometry and Vector of Model Curves and Curve By Points

VARElements = Input(VARElements: var[]..[])
code_block = CodeBlock { "ModelCurve"; "CurveByPoints"; "Elements.AdaptiveComponent"; }
byClassName = Custom[SP.Filter.ByClassName](VARobject=VARElements, VARclassName=code_block.out0)  # Filters a list of objects by the object's class name. Note that Dynamo elements belong to different classes than their Revit counterparts. Use the Object.Class node to check an object's class.
vector_of_model_curve = Custom[Vector of Model Curve](VARModelCurves=byClassName.VARin)  # Vector of Model Curve
curves = Element.Curves(element=byClassName.VARin)
byClassName_2 = Custom[SP.Filter.ByClassName](VARobject=byClassName.VARout, VARclassName=code_block.out1)
helix_to_curves = Custom[Helix to Curves](VARHelixElements=byClassName_2.VARin)  # Helix to Curves
byClassName_3 = Custom[SP.Filter.ByClassName](VARobject=byClassName_2.VARout, VARclassName=code_block.out2)
curves_2 = Element.Curves(element=byClassName_3.VARin)
flatten = List.Flatten(list=curves_2)
create = List.Create(item0=curves, item1=helix_to_curves, item2=flatten)
code_block_2 = CodeBlock { false; }
clean = List.Clean(list=create, preserveIndices=code_block_2)
flatten_2 = List.Flatten(list=clean)
VARCurves = Output(flatten_2)
