# Dynamo custom node Geometry.ExportToSAT Fixer.dyf (Dynamo 2.1.0.7500)
# category: Synthesize.Fixers
# Geometry.ExportToSAT Fixer

VARgeometry = Input(VARgeometry: var[]..[])
VARfilePath = Input(VARfilePath: var[]..[])
exportToSAT = Geometry.ExportToSAT(geometry=VARgeometry, filePath=VARfilePath)
VARstring = Output(exportToSAT)
