# Dynamo custom node Get Curtain Wall Geometry.dyf (Dynamo 2.1.0.7500)
# category: Synthesize.Automate.Solid
# Get Curtain Wall Geometry

VARCurtainWalls = Input(VARCurtainWalls: var[]..[])
turnIntoList = Custom[CW.TurnIntoList](VARunknownItem=VARCurtainWalls)  # Turns an element (or a nested list) into a flat list
python_script = Python(IN[0]=turnIntoList)
# ---------- python_script.python (132 lines) ----------
# Enable Python support and load DesignScript library
# IMPORTANT : ALL DYNAMO DESIGN SCRIPT NODES ARE AS (dg)
import clr
clr.AddReference('ProtoGeometry')
from Autodesk.DesignScript import Geometry as dg

import sys
sys.path.append(r'C:\Program Files (x86)\IronPython 2.7\DLLs')
sys.path.append(r'C:\Program Files (x86)\IronPython 2.7\Lib')
import random

# EXTENSION Enable ToDSType
clr.AddReference('RevitNodes')
import Revit
clr.ImportExtensions(Revit.Elements)

# Enable Revit Elements
from Revit.Elements import *

# EXTENSION Enable Geometry Conversion Methods
clr.ImportExtensions(Revit.GeometryConversion)

# Enable Revit API
clr.AddReference('RevitAPI')
from Autodesk.Revit.DB import *

# Enable DocumentManager and TransactionManager
clr.AddReference('RevitServices')
from RevitServices.Persistence import DocumentManager
from RevitServices.Transactions import TransactionManager

# Enable ICollection List Translate
clr.AddReference("System")
import System.Collections.Generic
from System.Collections.Generic import List

class WarnSwallow(IFailuresPreprocessor):
	def PreprocessFailures(self, failuresAccessor):
		failuresAccessor.DeleteAllWarnings()
		return FailureProcessingResult.Continue

def flatten(x):
    result = []
    for el in x:
        if hasattr(el, "__iter__") and not isinstance(el, basestring):
            result.extend(flatten(el))
        else:
            result.append(el)
    return result

def getsoulwall(csystem):
	e = csystem.CurtainGrid
	gridlist = []
	gridlistv = []
	cells = e.GetUGridLineIds()
	cellsv = e.GetVGridLineIds()
	tmp = []
	tmpv = []
	for x in cells:
		x = doc.GetElement(x)
		tmp.append(x.FullCurve.ToProtoType())
	for x in cellsv:
		x = doc.GetElement(x)
		tmpv.append(x.FullCurve.ToProtoType())
	gridlist.append(tmp)
	gridlistv.append(tmpv)
	return gridlist[0],gridlistv[0]

doc = DocumentManager.Instance.CurrentDBDocument
uidoc = DocumentManager.Instance.CurrentUIApplication.ActiveUIDocument
uiapp = DocumentManager.Instance.CurrentUIApplication
app = uiapp.Application

if int(DocumentManager.Instance.CurrentUIApplication.Application.VersionNumber) < 2021:
	formatoptions = doc.GetUnits().GetFormatOptions(UnitType.UT_Length)
	dispunits = formatoptions.DisplayUnits
	factor = UnitUtils.ConvertFromInternalUnits(1, dispunits)
else:
	factor = UnitUtils.ConvertFromInternalUnits(1,doc.GetUnits().GetFormatOptions(SpecTypeId.Length).GetUnitTypeId())

dataEnteringNode = IN
# Use UnwrapElement(IN[0]) When Translating From Dynamo to Revit
elems = UnwrapElement(IN[0])

result = []
resultgrids = []
walltype = FilteredElementCollector(doc).OfCategory(BuiltInCategory.OST_Walls).WhereElementIsElementType().FirstElement()
walltypewidth = walltype.Width

TransactionManager.Instance.EnsureInTransaction(doc)
for itm in elems:
	try:
		col1 = List[ElementId]()
		col1.Add(itm.Id)
		topstatus = itm.get_Parameter(BuiltInParameter.WALL_TOP_IS_ATTACHED).AsInteger()
		g1 = itm.get_BoundingBox(None).Max.Z
		g2 = itm.get_BoundingBox(None).Min.Z
		gtotal = g1 - g2
		gtotal *= 1.5
		if topstatus == 1:
			parm = itm.get_Parameter(BuiltInParameter.WALL_USER_HEIGHT_PARAM)
			oldvalue = parm.AsDouble()
			parm.Set(gtotal)
			itmnew = ElementTransformUtils.CopyElements(doc, col1, XYZ(0,0,0))
			parm.Set(oldvalue)
		else:
			itmnew = ElementTransformUtils.CopyElements(doc, col1, XYZ(0,0,0))
		wall = doc.GetElement(itmnew[0])
		wall.ChangeTypeId(walltype.Id)
		WallUtils.DisallowWallJoinAtEnd(wall,0)
		WallUtils.DisallowWallJoinAtEnd(wall,1)
		allgeom = Revit.Elements.Element.Geometry(wall.ToDSType(True))
		curtype = doc.GetElement(itm.GetTypeId())
		embedparm = curtype.get_Parameter(BuiltInParameter.ALLOW_AUTO_EMBED)
		embedstatus = embedparm.AsInteger()
		embedparm.Set(1)
		Revit.Transaction.Transaction.End(doc)
		tosubtractfrom = Revit.Elements.Element.Geometry(wall.ToDSType(True))
		embedparm.Set(embedstatus)
		doc.Delete(wall.Id)
		try:
			diff = dg.Solid.Difference(allgeom[0],tosubtractfrom[0])
		except:
			diff = allgeom[0]
		extruding = dg.Curve.Extrude(itm.Location.Curve.ToProtoType(),dg.Vector.ZAxis(),gtotal*factor)
		result.append(dg.Geometry.Intersect(diff,extruding)[0])
		resultgrids.append(getsoulwall(itm))
	except:
		pass
TransactionManager.Instance.TransactionTaskDone()

OUT = result,resultgrids
# ----------------------------------------
code_block = CodeBlock(a=python_script) { a[0]; }
VARSurfaces = Output(code_block)
code_block_2 = CodeBlock(a=python_script) { a[1]; }
firstItem = List.FirstItem(list=code_block_2@@L3)
VARGridsU = Output(firstItem)
lastItem = List.LastItem(list=code_block_2@@L3)
VARGridsV = Output(lastItem)
