# Dynamo custom node Get Divided Surface Smooth Lines By Surfaces Selection.dyf (Dynamo 2.1.0.7500)
# category: Synthesize.Automate.DividedSurface
# Get Divided Surface Smooth Lines By Surfaces Selection

VARSurfaces = Input(VARSurfaces: var[]..[])
flatten = List.Flatten(list=VARSurfaces)
VARSurfaces_2 = Output(flatten)  # "VARSurfaces"
code_block = CodeBlock { null; 0; false; }
create = List.Create(item0=code_block.out0)
get_divided_surfaces_of_surfaces = Custom[Get Divided Surfaces of Surfaces](VARSurfaces=flatten)  # Get Divided Surfaces of Surfaces
isNull = Object.IsNull(obj=get_divided_surfaces_of_surfaces)
countTrue = List.CountTrue(list=isNull)
ofRepeatedItem = List.OfRepeatedItem(item=create, amount=countTrue)
filterByBoolMask = List.FilterByBoolMask(list=get_divided_surfaces_of_surfaces, mask=isNull)
filterByBoolMask_2 = List.FilterByBoolMask(list=flatten, mask=isNull)
python_script = Python(IN[0]=filterByBoolMask.out, IN[1]=filterByBoolMask_2.out)
# ---------- python_script.python (137 lines) ----------
# Enable Python support and load DesignScript library
# IMPORTANT : ALL DYNAMO DESIGN SCRIPT NODES ARE AS (dg)
import clr
clr.AddReference('ProtoGeometry')
from Autodesk.DesignScript import Geometry as dg

# EXTENSION Enable ToDSType
clr.AddReference('RevitNodes')
import Revit
clr.ImportExtensions(Revit.Elements)

# Enable Revit Elements
from Revit.Elements import *

# EXTENSION Enable Geometry Conversion Methods
clr.ImportExtensions(Revit.GeometryConversion)

# Enable Revit API
clr.AddReference('RevitAPI')
from Autodesk.Revit.DB import *

# Enable DocumentManager and TransactionManager
clr.AddReference('RevitServices')
from RevitServices.Persistence import DocumentManager
from RevitServices.Transactions import TransactionManager

# Enable ICollection List Translate
clr.AddReference("System")
import System.Collections.Generic
from System.Collections.Generic import List

dataEnteringNode = IN
# Use UnwrapElement(IN[0]) When Translating From Dynamo to Revit
divs = UnwrapElement(IN[0])
surfs = UnwrapElement(IN[1])

# Choose The Current Document
doc = DocumentManager.Instance.CurrentDBDocument
uidoc = DocumentManager.Instance.CurrentUIApplication.ActiveUIDocument
uiapp = DocumentManager.Instance.CurrentUIApplication
app = uiapp.Application

def doesinter(a,b,tollerance = 0.05):
	try:
		if round(dg.Geometry.DistanceTo(a,b),2) < tollerance:
			return True
		else:
			return False
	except:
		return False

def cleangeom(geom,surf):
	meshfound = False
	for g in geom:
		if g.ToString() == "Autodesk.Revit.DB.Mesh":
			meshfound = True
			break
	fixgeom = []		
	for g in geom:
		stringcompare = g.ToString()
		if meshfound:
			if stringcompare == "Autodesk.Revit.DB.Mesh":
				fixgeom.append(g)
		else:
			if stringcompare != "Autodesk.Revit.DB.Point" and stringcompare != "Autodesk.Revit.DB.Solid":
				fixgeom.append(g)
	result = []
	for e in fixgeom:
		try:
			try:
				conv = e.GeometryCurve
			except:
				conv = e
			if conv.ToString() != "Autodesk.Revit.DB.CylindricalHelix":
				result.append(conv.ToProtoType())
			else:
				tess = conv.Tessellate()
				tmp = []
				for s in tess:
					tmp.append(s.ToPoint())
				result.append(dg.NurbsCurve.ByPoints(tmp))
		except:
			result.append(None)
	slist = result
	newlists = []
	perm = surf.PerimeterCurves()
	count = 0
	for s in slist:
		f = fixgeom[count]
		count += 1
		if s.ToString() == "Mesh":
			newlists.append(f)
			continue
		if s != None:
			breakstatus = False
			for p in perm:
				if doesinter(dg.Curve.PointAtParameter(s,0.3),p) and doesinter(dg.Curve.PointAtParameter(s,0.3),p):
					breakstatus = True
					break
			if breakstatus == False:
				newlists.append(f)
	return newlists

opt1 = Options()

result = []
parmU = []
TransactionManager.Instance.ForceCloseTransaction()
trans = Transaction(doc, 'Fetching Divided Surface')
trans.Start()
count = 0
for div in divs:
	surf = surfs[count]
	count += 1
	if div.USpacingRule.Layout.ToString() != "None" and div.VSpacingRule.Layout.ToString() == "None":
		geom = cleangeom(div.get_Geometry(opt1),surf)
		parmU.append(len(geom))
		result.append(geom)
	elif div.USpacingRule.Layout.ToString() == "None" and div.VSpacingRule.Layout.ToString() != "None":
		geom = cleangeom(div.get_Geometry(opt1),surf)
		parmU.append(0)
		result.append(geom)
	elif div.USpacingRule.Layout.ToString() != "None" and div.VSpacingRule.Layout.ToString() != "None":
		subtran = SubTransaction(doc)
		subtran.Start()
		div.get_Parameter(BuiltInParameter.SPACING_LAYOUT_V).Set(0)
		doc.Regenerate()
		tmpgeom = cleangeom(div.get_Geometry(opt1),surf)
		subtran.RollBack()
		parmU.append(len(tmpgeom))
		geom = cleangeom(div.get_Geometry(opt1),surf)
		result.append(geom)
	else:
		result.append(None)
		parmU.append(0)
trans.RollBack()
OUT = result,parmU
# ----------------------------------------
code_block_2 = CodeBlock(a=python_script) { a[0]; a[1]; }
helix_to_curves = Custom[Helix to Curves](VARHelixElements=code_block_2.out0@L2)  # Helix to Curves
python_script_2 = Python(IN[0]=helix_to_curves, IN[1]=filterByBoolMask_2.out)
# ---------- python_script_2.python (34 lines) ----------
import clr
clr.AddReference('ProtoGeometry')
from Autodesk.DesignScript.Geometry import *
#The inputs to this node will be stored as a list in the IN variables.
dataEnteringNode = IN

class MyList(list):
    def __contains__(self, typ):
        for val in self:
            if isinstance(val, typ):
                return True
        return False
    
lists = UnwrapElement(IN[0])
surfs = IN[1]

lines = []
surflines = []
pat = []
surfpat = []
bool = []
count = 0
for l in lists:
	if Mesh in MyList(l):
		pat.append([i for i in l if i])
		surfpat.append(surfs[count])
		bool.append(True)
	else:
		lines.append([i for i in l if i])
		surflines.append(surfs[count])
		bool.append(False)
	count += 1
#Assign your output to the OUT variable.
OUT = lines,surflines,pat,surfpat,bool
# ----------------------------------------
code_block_3 = CodeBlock(a=python_script_2) { a[0]; a[1]; a[2]; a[3]; a[4]; }
code_block_4 = CodeBlock { 2; }
normalizeDepth = List.NormalizeDepth(list=code_block_3.out2, rank=code_block_4)
code_block_5 = CodeBlock { "Mesh"; }
byClassName = Custom[SP.Filter.ByClassName](VARobject=normalizeDepth@L2, VARclassName=code_block_5)  # Filters a list of objects by the object's class name. Note that Dynamo elements belong to different classes than their Revit counterparts. Use the Object.Class node to check an object's class.
vertexPositions = Mesh.VertexPositions(mesh=byClassName.VARin)
code_block_6 = CodeBlock { 0.01; }
pruneDuplicates = Point.PruneDuplicates(points=vertexPositions@L3, tolerance=code_block_6)
UVParameterAtPoint = Surface.UVParameterAtPoint(surface=code_block_3.out3, point=pruneDuplicates)
lastItem = List.LastItem(list=UVParameterAtPoint@@L2)
addItemToFront = List.AddItemToFront(item=lastItem@@L1, list=UVParameterAtPoint@L2)
subpairs = Custom[SP.List.Subpairs](VARlist=addItemToFront@@L2)  # Pair up each list item with the next one and drop the list item.
firstItem = List.FirstItem(list=subpairs@@L2)
lastItem_2 = List.LastItem(list=subpairs@@L2)
byParameterLineOnSurface = Curve.ByParameterLineOnSurface(baseSurface=code_block_3.out3, startParams=firstItem, endParams=lastItem_2)
python_script_3 = Python(IN[0]=code_block_3.out3, IN[1]=byParameterLineOnSurface)
# ---------- python_script_3.python (73 lines) ----------
# Enable Python support and load DesignScript library
# IMPORTANT : ALL DYNAMO DESIGN SCRIPT NODES ARE AS (dg)
import clr
clr.AddReference('ProtoGeometry')
from Autodesk.DesignScript import Geometry as dg

# EXTENSION Enable ToDSType
clr.AddReference('RevitNodes')
import Revit
clr.ImportExtensions(Revit.Elements)

# Enable Revit Elements
from Revit.Elements import *

# EXTENSION Enable Geometry Conversion Methods
clr.ImportExtensions(Revit.GeometryConversion)

# Enable Revit API
clr.AddReference('RevitAPI')
from Autodesk.Revit.DB import *

# Enable DocumentManager and TransactionManager
clr.AddReference('RevitServices')
from RevitServices.Persistence import DocumentManager
from RevitServices.Transactions import TransactionManager

# Enable ICollection List Translate
clr.AddReference("System")
import System.Collections.Generic
from System.Collections.Generic import List

dataEnteringNode = IN
# Use UnwrapElement(IN[0]) When Translating From Dynamo to Revit
surfs=UnwrapElement(IN[0])
lists=UnwrapElement(IN[1])

# Choose The Current Document
doc = DocumentManager.Instance.CurrentDBDocument
uidoc = DocumentManager.Instance.CurrentUIApplication.ActiveUIDocument
uiapp = DocumentManager.Instance.CurrentUIApplication
app = uiapp.Application

# Create Empty List
result = []

def doesinter(a,b,tollerance = 0.05):
	if round(dg.Geometry.DistanceTo(a,b),2) < tollerance:
		return True
	else:
		return False

newlists = []
count = 0
for surf in surfs:
	slist = lists[count]
	perm = surf.PerimeterCurves() 
	count += 1
	tmpslist = []
	for sall in slist:
		tmpall = []
		for s in sall:
			breakstatus = False
			for p in perm:
				if doesinter(dg.Curve.PointAtParameter(s,0.3),p) and doesinter(dg.Curve.PointAtParameter(s,0.3),p):
					breakstatus = True
					break
			if breakstatus == False:
				tmpall.append(s)
		tmpslist.append(tmpall)
	newlists.append(tmpslist)

# Assign your output to the OUT variable.
OUT = newlists
# ----------------------------------------
as_polycurve_bycurves_with = Custom[AS.[&] PolyCurve.ByCurves With Failures](VARcurves=python_script_3)  # Create polycurves from an unordered list of curves.
code_block_7 = CodeBlock { 2; }
normalizeDepth_2 = List.NormalizeDepth(list=as_polycurve_bycurves_with.VARpolyCurve, rank=code_block_7)
python_script_4 = Python(IN[0]=code_block_3.out1, IN[1]=code_block_3.out0)
# ---------- python_script_4.python (72 lines) ----------
# Enable Python support and load DesignScript library
# IMPORTANT : ALL DYNAMO DESIGN SCRIPT NODES ARE AS (dg)
import clr
clr.AddReference('ProtoGeometry')
from Autodesk.DesignScript import Geometry as dg

# EXTENSION Enable ToDSType
clr.AddReference('RevitNodes')
import Revit
clr.ImportExtensions(Revit.Elements)

# Enable Revit Elements
from Revit.Elements import *

# EXTENSION Enable Geometry Conversion Methods
clr.ImportExtensions(Revit.GeometryConversion)

# Enable Revit API
clr.AddReference('RevitAPI')
from Autodesk.Revit.DB import *

# Enable DocumentManager and TransactionManager
clr.AddReference('RevitServices')
from RevitServices.Persistence import DocumentManager
from RevitServices.Transactions import TransactionManager

# Enable ICollection List Translate
clr.AddReference("System")
import System.Collections.Generic
from System.Collections.Generic import List

dataEnteringNode = IN
# Use UnwrapElement(IN[0]) When Translating From Dynamo to Revit
surfs=UnwrapElement(IN[0])
lists=UnwrapElement(IN[1])

# Choose The Current Document
doc = DocumentManager.Instance.CurrentDBDocument
uidoc = DocumentManager.Instance.CurrentUIApplication.ActiveUIDocument
uiapp = DocumentManager.Instance.CurrentUIApplication
app = uiapp.Application

# Create Empty List
result = []

def doesinter(a,b,tollerance = 0.05):
	try:
		if round(dg.Geometry.DistanceTo(a,b),2) < tollerance:
			return True
		else:
			return False
	except:
		return False

newlists = []
count = 0
for surf in surfs:
	slist = lists[count]
	perm = surf.PerimeterCurves() 
	count += 1
	tmpall = []
	for s in slist:
		breakstatus = False
		for p in perm:
			if doesinter(dg.Curve.PointAtParameter(s,0.3),p) and doesinter(dg.Curve.PointAtParameter(s,0.3),p):
				breakstatus = True
				break
		if breakstatus == False:
			tmpall.append(s)
	newlists.append(tmpall)
# Assign your output to the OUT variable.
OUT = newlists
# ----------------------------------------
mergeByBoolMask = Custom[SP.List.MergeByBoolMask](VARIn=normalizeDepth_2, VAROut=python_script_4, VARmask=code_block_3.out4)  # Merge two lists by a boolean mask list. The true count in the mask should be the same as the length of the true list and vice versa for the false list.
python_script_5 = Python(IN[0]=mergeByBoolMask, IN[1]=code_block_3.out4, IN[2]=code_block_2.out1)
# ---------- python_script_5.python (39 lines) ----------
import clr
clr.AddReference('ProtoGeometry')
from Autodesk.DesignScript.Geometry import *
#The inputs to this node will be stored as a list in the IN variables.
dataEnteringNode = IN

lists = IN[0]
bool = IN[1]
nums = IN[2]

def split_list(a_list,num):
	if num != 0:
		half = num
		ahalf = a_list[:half]
		bhalf = a_list[half:]
		if ahalf == []:
			ahalf = [None]
		if bhalf == []:
			bhalf = [None]
		return ahalf, bhalf
	else:
		if a_list == []:
			a_list = [None]
		return [None],a_list

result = []
count = 0
for b in bool:
	cur = lists[count]
	num = nums[count]
	if b == True:
		cur = [cur,[None]]
		result.append(cur)
	else:
		cur = split_list(cur,num)
		result.append(cur)
	count += 1
#Assign your output to the OUT variable.
OUT = result
# ----------------------------------------
transpose = List.Transpose(lists=python_script_5)
code_block_8 = CodeBlock { 0; 1; }
getItemAtIndex = List.GetItemAtIndex(list=transpose, index=code_block_8.out0)
mergeByBoolMask_2 = Custom[SP.List.MergeByBoolMask](VARIn=ofRepeatedItem, VAROut=getItemAtIndex, VARmask=isNull)
isNull_2 = Object.IsNull(obj=mergeByBoolMask_2)
allFalse = List.AllFalse(list=isNull_2@L2)
filterByBoolMask_3 = List.FilterByBoolMask(list=mergeByBoolMask_2, mask=allFalse)
explode = Geometry.Explode(geometry=filterByBoolMask_3.in)
flatten_2 = List.Flatten(list=explode@L3)
as_overkill_bycurves = Custom[AS.[&] Overkill ByCurves](VARcurves=flatten_2)  # Create polycurves from an unordered list of curves.
mergeByBoolMask_3 = Custom[SP.List.MergeByBoolMask](VARIn=as_overkill_bycurves, VAROut=filterByBoolMask_3.out, VARmask=allFalse)
VARUGrid = Output(mergeByBoolMask_3)
getItemAtIndex_2 = List.GetItemAtIndex(list=transpose, index=code_block_8.out1)
mergeByBoolMask_4 = Custom[SP.List.MergeByBoolMask](VARIn=ofRepeatedItem, VAROut=getItemAtIndex_2, VARmask=isNull)
isNull_3 = Object.IsNull(obj=mergeByBoolMask_4)
allFalse_2 = List.AllFalse(list=isNull_3@L2)
filterByBoolMask_4 = List.FilterByBoolMask(list=mergeByBoolMask_4, mask=allFalse_2)
explode_2 = Geometry.Explode(geometry=filterByBoolMask_4.in)
flatten_3 = List.Flatten(list=explode_2@L3)
as_overkill_bycurves_2 = Custom[AS.[&] Overkill ByCurves](VARcurves=flatten_3)
mergeByBoolMask_5 = Custom[SP.List.MergeByBoolMask](VARIn=as_overkill_bycurves_2, VAROut=filterByBoolMask_4.out, VARmask=allFalse_2)
VARVGrid = Output(mergeByBoolMask_5)
python_script_6 = Python(IN[0]=mergeByBoolMask_2)
# ---------- python_script_6.python (20 lines) ----------
# Load the Python Standard and DesignScript Libraries
import sys
import clr
clr.AddReference('ProtoGeometry')
from Autodesk.DesignScript.Geometry import *

lists = IN[0]

result = []

for l in lists:
	cleanl = []
	for n in l:
		if n != None:
			cleanl.append(n)
	result.append(len(cleanl))


# Assign your output to the OUT variable.
OUT = result
# ----------------------------------------
VARCountU = Output(python_script_6)
python_script_7 = Python(IN[0]=mergeByBoolMask_4)  # same code as python_script_6
VARVCountV = Output(python_script_7)
filterByBoolMask_5 = List.FilterByBoolMask(list=flatten, mask=isNull)
filterByBoolMask_6 = List.FilterByBoolMask(list=mergeByBoolMask_2, mask=isNull)
filterByBoolMask_7 = List.FilterByBoolMask(list=mergeByBoolMask_4, mask=isNull)
countTrue_2 = List.CountTrue(list=isNull)
ofRepeatedItem_2 = List.OfRepeatedItem(item=code_block.out1, amount=countTrue_2)
mergeByBoolMask_6 = Custom[SP.List.MergeByBoolMask](VARIn=ofRepeatedItem_2, VAROut=code_block_2.out1, VARmask=isNull)
filterByBoolMask_8 = List.FilterByBoolMask(list=mergeByBoolMask_6, mask=isNull)
count = List.Count(list=flatten)
cycle = List.Cycle(list=code_block.out2, amount=count)
VARFlipStatus = Output(cycle)
filterByBoolMask_9 = List.FilterByBoolMask(list=cycle, mask=isNull)
