# Dynamo custom node Get Document Name.dyf (Dynamo 2.1.0.7500)
# category: Synthesize.Automate.Document
# Get Document Name

VARDocument = Input(VARDocument: var[]..[])
python_script = Python(IN[0]=VARDocument)
# ---------- python_script.python (38 lines) ----------
# Enable Python support and load DesignScript library
# IMPORTANT : ALL DYNAMO DESIGN SCRIPT NODES ARE AS (dg)
import clr
clr.AddReference('ProtoGeometry')
from Autodesk.DesignScript import Geometry as dg

# EXTENSION Enable ToDSType
clr.AddReference('RevitNodes')
import Revit
clr.ImportExtensions(Revit.Elements)

# Enable Revit Elements
from Revit.Elements import *

# EXTENSION Enable Geometry Conversion Methods
clr.ImportExtensions(Revit.GeometryConversion)

# Enable Revit API
clr.AddReference('RevitAPI')
from Autodesk.Revit.DB import *

# Enable DocumentManager and TransactionManager
clr.AddReference('RevitServices')
from RevitServices.Persistence import DocumentManager
from RevitServices.Transactions import TransactionManager

# Enable ICollection List Translate
clr.AddReference("System")
import System.Collections.Generic
from System.Collections.Generic import List

dataEnteringNode = IN
# Use UnwrapElement(IN[0]) When Translating From Dynamo to Revit
doc = UnwrapElement(IN[0])

result = doc.PathName
# Assign your output to the OUT variable.
OUT = result
# ----------------------------------------
string = StringInput("\")
split = String.Split(str=python_script, separator0=string)
lastItem = List.LastItem(list=split)
VARName = Output(lastItem)
VARPath = Output(python_script)
