# Dynamo custom node Get Family Instances of Divided Surface.dyf (Dynamo 2.1.0.7500)
# category: Synthesize.Automate.DividedSurface
# Get Family Instances of Divided Surface

VARDividedSurfaces = Input(VARDividedSurfaces: var[]..[])
turnIntoList = Custom[CW.TurnIntoList](VARunknownItem=VARDividedSurfaces)  # Turns an element (or a nested list) into a flat list
python_script = Python(IN[0]=turnIntoList)
# ---------- python_script.python (55 lines) ----------
# Enable Python support and load DesignScript library
# IMPORTANT : ALL DYNAMO DESIGN SCRIPT NODES ARE AS (dg)
import clr
clr.AddReference('ProtoGeometry')
from Autodesk.DesignScript import Geometry as dg

# EXTENSION Enable ToDSType
clr.AddReference('RevitNodes')
import Revit
clr.ImportExtensions(Revit.Elements)

# Enable Revit Elements
from Revit.Elements import *

# EXTENSION Enable Geometry Conversion Methods
clr.ImportExtensions(Revit.GeometryConversion)

# Enable Revit API
clr.AddReference('RevitAPI')
from Autodesk.Revit.DB import *

# Enable DocumentManager and TransactionManager
clr.AddReference('RevitServices')
from RevitServices.Persistence import DocumentManager
from RevitServices.Transactions import TransactionManager

# Enable ICollection List Translate
clr.AddReference("System")
import System.Collections.Generic
from System.Collections.Generic import List

dataEnteringNode = IN
# Use UnwrapElement(IN[0]) When Translating From Dynamo to Revit
allfaces=UnwrapElement(IN[0])

# Choose The Current Document
doc = DocumentManager.Instance.CurrentDBDocument
uidoc = DocumentManager.Instance.CurrentUIApplication.ActiveUIDocument
uiapp = DocumentManager.Instance.CurrentUIApplication
app = uiapp.Application

# Create Empty List
result = []

filter = ElementClassFilter(FamilyInstance)

for faces in allfaces:
	ids = faces.GetDependentElements(filter)
	tmp = []
	for id in ids:
		tmp.append(doc.GetElement(id))
	result.append(tmp)

# Assign your output to the OUT variable.
OUT = result
# ----------------------------------------
VARFamilyInstances = Output(python_script)
