# Dynamo custom node Get Family and Type Name By Family Instance.dyf (Dynamo 2.1.0.7500)
# category: Synthesize.Automate.Family
# Get Family and Type Name

VARFamilyInstance = Input(VARFamilyInstance: var[]..[])
turnIntoList = Custom[CW.TurnIntoList](VARunknownItem=VARFamilyInstance)  # Turns an element (or a nested list) into a flat list
python_script = Python(IN[0]=turnIntoList)
# ---------- python_script.python (66 lines) ----------
# Enable Python support and load DesignScript library
# IMPORTANT : ALL DYNAMO DESIGN SCRIPT NODES ARE AS (dg)
import clr
clr.AddReference('ProtoGeometry')
from Autodesk.DesignScript import Geometry as dg

# EXTENSION Enable ToDSType
clr.AddReference('RevitNodes')
import Revit
clr.ImportExtensions(Revit.Elements)

# Enable Revit Elements
from Revit.Elements import *

# EXTENSION Enable Geometry Conversion Methods
clr.ImportExtensions(Revit.GeometryConversion)

# Enable Revit API
clr.AddReference('RevitAPI')
from Autodesk.Revit.DB import *

# Enable DocumentManager and TransactionManager
clr.AddReference('RevitServices')
from RevitServices.Persistence import DocumentManager
from RevitServices.Transactions import TransactionManager

# Enable ICollection List Translate
clr.AddReference("System")
import System.Collections.Generic
from System.Collections.Generic import List

dataEnteringNode = IN
# Use UnwrapElement(IN[0]) When Translating From Dynamo to Revit
inside=UnwrapElement(IN[0])


# Choose The Current Document
doc = DocumentManager.Instance.CurrentDBDocument
uidoc = DocumentManager.Instance.CurrentUIApplication.ActiveUIDocument
uiapp = DocumentManager.Instance.CurrentUIApplication
app = uiapp.Application

# Create Empty List
typename = []
familyname = []
ids = []
elementtypes = []
for each in inside:
	try:
		typename.append(each.Name)
	except: 
		typename.append("Failed To Get Type Name")
	try:
		familyname.append(doc.GetElement(each.GetTypeId()).FamilyName)
	except:
		familyname.append("Failed To Get Family Name")
	try:
		ids.append(str(each.Id))
	except:
		ids.append("Failed To Get ID")
	try:
		elementtypes.append(doc.GetElement(each.GetTypeId()))
	except:
		elementtypes.append(None)
# Assign your output to the OUT variable.
OUT = familyname, typename, ids, elementtypes
# ----------------------------------------
code_block = CodeBlock(a=python_script) { a[0]; a[1]; a[2]; a[3]; }
VARFamilyName = Output(code_block.out0)
VARTypeName = Output(code_block.out1)
VARElementID = Output(code_block.out2)
VARElementTypes = Output(code_block.out3)
