# Dynamo custom node Get Pure Surfaces of Flat Detected Adaptive Components.dyf (Dynamo 2.1.0.7500)
# category: Synthesize.Automate.Adaptive
# Get Pure Surfaces of Flat Detected Adaptive Components

python_all_elements_in_active = Custom[Python All Elements In Active View]()  # Python All Elements In Active View
python_script = Python(IN[0]=python_all_elements_in_active)
# ---------- python_script.python (54 lines) ----------
# Enable Python support and load DesignScript library
# IMPORTANT : ALL DYNAMO DESIGN SCRIPT NODES ARE AS (dg)
import clr
clr.AddReference('ProtoGeometry')
from Autodesk.DesignScript import Geometry as dg

# EXTENSION Enable ToDSType
clr.AddReference('RevitNodes')
import Revit
clr.ImportExtensions(Revit.Elements)

# Enable Revit Elements
from Revit.Elements import *

# EXTENSION Enable Geometry Conversion Methods
clr.ImportExtensions(Revit.GeometryConversion)

# Enable Revit API
clr.AddReference('RevitAPI')
from Autodesk.Revit.DB import *

# Enable DocumentManager and TransactionManager
clr.AddReference('RevitServices')
from RevitServices.Persistence import DocumentManager
from RevitServices.Transactions import TransactionManager

# Enable ICollection List Translate
clr.AddReference("System")
import System.Collections.Generic
from System.Collections.Generic import List

dataEnteringNode = IN
# Use UnwrapElement(IN[0]) When Translating From Dynamo to Revit
elems=UnwrapElement(IN[0])

# Choose The Current Document
doc = DocumentManager.Instance.CurrentDBDocument
uidoc = DocumentManager.Instance.CurrentUIApplication.ActiveUIDocument
uiapp = DocumentManager.Instance.CurrentUIApplication
app = uiapp.Application

# Create Empty List
totest = []
for le in elems:
	if hasattr(le, 'Symbol'):
		symb = le.Symbol.Family
		symbid = symb.Id
		try:
			if AdaptiveComponentFamilyUtils.IsAdaptiveComponentFamily(symb) == True:
				totest.append(le)
		except:
			pass
# Assign your output to the OUT variable.
OUT = totest
# ----------------------------------------
code_block = CodeBlock { true; }
location_of_any_element = Custom[Location Of Any Element](VARElements=python_script, VARGetAllPointsOfAdaptiveComponents=code_block)  # Location Of Any Element
join = List.Join()  # unwired: list0, list1
VARSurfaces = Input(VARSurfaces: var[]..[])
flatten = List.Flatten(list=VARSurfaces)
code_block_2 = CodeBlock { 1; -1; }
translate = Geometry.Translate(geometry=flatten, zTranslation=code_block_2.out1)
turnIntoList = Custom[CW.TurnIntoList](VARunknownItem=translate)  # Turns an element (or a nested list) into a flat list
translate_2 = Geometry.Translate(geometry=flatten, zTranslation=code_block_2.out0)
turnIntoList_2 = Custom[CW.TurnIntoList](VARunknownItem=translate_2)
combine = List.Combine(comb=join, list1=turnIntoList, list2=turnIntoList_2)
byGeometry = BoundingBox.ByGeometry(geom=combine@L2)
code_block_3 = CodeBlock { 2; }
normalizeDepth = List.NormalizeDepth(list=location_of_any_element.VARLocations, rank=code_block_3)
contains = BoundingBox.Contains(boundingBox=byGeometry, point=normalizeDepth@L2, lacing=Longest)
anyTrue = Custom[CW.List.AnyTrue](VARseq=contains)  # Returns true if any item in a list of booleans is true.
filterByBoolMask = List.FilterByBoolMask(list=location_of_any_element.VARElements, mask=anyTrue)
firstItem = List.FirstItem(list=filterByBoolMask.in@L2)
type = FamilyInstance.Type(familyInstance=firstItem)
adaptive_family_orientation_type = Custom[Adaptive Family Orientation Type](VARFamilyType=type@L1)  # Adaptive Family Orientation Type (Along With Other Useful Information
filterByBoolMask_2 = List.FilterByBoolMask(list=location_of_any_element.VARLocations, mask=anyTrue)
byPoints = Polygon.ByPoints(points=filterByBoolMask_2.in)
byPatch = Surface.ByPatch(closedCurve=byPoints)
join_2 = List.Join()  # unwired: list0, list1
turnIntoList_3 = Custom[CW.TurnIntoList](VARunknownItem=flatten)
code_block_4 = CodeBlock { 1; }
translate_3 = Geometry.Translate(geometry=flatten, zTranslation=code_block_4)
turnIntoList_4 = Custom[CW.TurnIntoList](VARunknownItem=translate_3)
combine_2 = List.Combine(comb=join_2, list1=turnIntoList_3, list2=turnIntoList_4)
byGeometry_2 = BoundingBox.ByGeometry(geom=combine_2@L2)
toCuboid = BoundingBox.ToCuboid(boundingBox=byGeometry_2)
explode = Geometry.Explode(geometry=toCuboid)
filterByOrientation = Custom[CW.Surface.FilterByOrientation](VARsurfaces=explode)  # Sorts surfaces in three lists based on their orientation (vertical, horizontal up & horizontal down) and also returns three corresponding lists of booleans.
centerPoint = Custom[ZK.BoundingBox.CenterPoint](VARBoundingBox=byGeometry_2)  # Input Bounding Box element to get its center point. This node is little and lightweight, as it doesn't convert bounding box to geometry to get its centroid point.
byOriginNormal = Plane.ByOriginNormal(origin=centerPoint)
code_block_5 = CodeBlock { 2; }
scale = Geometry.Scale(geometry=filterByOrientation.VARhorizontalDown, plane=byOriginNormal, xamount=code_block_5, yamount=code_block_5)
thicken = Surface.Thicken(surface=flatten)
subtractFrom = Surface.SubtractFrom(surface=scale, trimmingEntity=thicken)
flatten_2 = List.Flatten(list=subtractFrom)
thicken_2 = Surface.Thicken(surface=flatten_2)
subtractFrom_2 = Surface.SubtractFrom(surface=byPatch@L2, trimmingEntity=thicken_2, lacing=Longest)
flatten_3 = List.Flatten(list=subtractFrom_2@L3)
python_script_2 = Python(IN[0]=adaptive_family_orientation_type.VARPatternType, IN[1]=flatten, IN[2]=flatten_3)
# ---------- python_script_2.python (72 lines) ----------
# Enable Python support and load DesignScript library
# IMPORTANT : ALL DYNAMO DESIGN SCRIPT NODES ARE AS (dg)
import clr
clr.AddReference('ProtoGeometry')
from Autodesk.DesignScript import Geometry as dg

# EXTENSION Enable ToDSType
clr.AddReference('RevitNodes')
import Revit
clr.ImportExtensions(Revit.Elements)

# Enable Revit Elements
from Revit.Elements import *

# EXTENSION Enable Geometry Conversion Methods
clr.ImportExtensions(Revit.GeometryConversion)

# Enable Revit API
clr.AddReference('RevitAPI')
from Autodesk.Revit.DB import *

# Enable DocumentManager and TransactionManager
clr.AddReference('RevitServices')
from RevitServices.Persistence import DocumentManager
from RevitServices.Transactions import TransactionManager

# Enable ICollection List Translate
clr.AddReference("System")
import System.Collections.Generic
from System.Collections.Generic import List

def flatten(x):
    result = []
    for el in x:
        if hasattr(el, "__iter__") and not isinstance(el, basestring):
            result.extend(flatten(el))
        else:
            result.append(el)
    return result

dataEnteringNode = IN
# Use UnwrapElement(IN[0]) When Translating From Dynamo to Revit
allcondi=UnwrapElement(IN[0])
orgsurf=UnwrapElement(IN[1])
tosub=UnwrapElement(IN[2])

# Choose The Current Document
doc = DocumentManager.Instance.CurrentDBDocument
uidoc = DocumentManager.Instance.CurrentUIApplication.ActiveUIDocument
uiapp = DocumentManager.Instance.CurrentUIApplication
app = uiapp.Application

# Create Empty List
result = []
count = 0
for condi in allcondi:
	if condi == "Octagon" or condi == "OctagonRotate":
		try:
			tmp = []
			tmp.append(dg.Surface.Difference(orgsurf[count],tosub[count]).Surfaces())
			tmp.append(tosub[count])
			result.append(flatten(tmp))
		except:
			result.append(tosub[count])
	else:
		if len(tosub[count]) == 0:
			result.append([None])
		else:
			result.append(tosub[count])
	count += 1
# Assign your output to the OUT variable.
OUT = result
# ----------------------------------------
code_block_6 = CodeBlock(VARSurfaces=python_script_2) { VARSurfaces; }
VARSurfaces_2 = Output(code_block_6)  # "VARSurfaces"
