# Dynamo custom node Get Pure Surfaces of Flat Divided Surface.dyf (Dynamo 2.1.0.7500)
# category: Synthesize.Automate.DividedSurface
# Get Pure Surfaces of Divided Surface

VARSurfaces = Input(VARSurfaces: var[]..[])
flatten = List.Flatten(list=VARSurfaces)
get_divided_surfaces_of_surfaces = Custom[Get Divided Surfaces of Surfaces](VARSurfaces=flatten)  # Get Divided Surfaces of Surfaces
get_family_instances_of_divided = Custom[Get Family Instances of Divided Surface](VARDividedSurfaces=get_divided_surfaces_of_surfaces)  # Get Family Instances of Divided Surface
location_of_any_element = Custom[Location Of Any Element](VARElements=get_family_instances_of_divided@L2)  # Location Of Any Element
firstItem = List.FirstItem(list=location_of_any_element.VARElements@L2)
type = FamilyInstance.Type(familyInstance=firstItem)
adaptive_family_orientation_type = Custom[Adaptive Family Orientation Type](VARFamilyType=type@L1)  # Adaptive Family Orientation Type (Along With Other Useful Information
byPatch = Surface.ByPatch(closedCurve=location_of_any_element.VARLocations)
join = List.Join()  # unwired: list0, list1
turnIntoList = Custom[CW.TurnIntoList](VARunknownItem=flatten)  # Turns an element (or a nested list) into a flat list
code_block = CodeBlock { 1; }
translate = Geometry.Translate(geometry=flatten, zTranslation=code_block)
turnIntoList_2 = Custom[CW.TurnIntoList](VARunknownItem=translate)
combine = List.Combine(comb=join, list1=turnIntoList, list2=turnIntoList_2)
byGeometry = BoundingBox.ByGeometry(geom=combine@L2)
toCuboid = BoundingBox.ToCuboid(boundingBox=byGeometry)
explode = Geometry.Explode(geometry=toCuboid)
filterByOrientation = Custom[CW.Surface.FilterByOrientation](VARsurfaces=explode)  # Sorts surfaces in three lists based on their orientation (vertical, horizontal up & horizontal down) and also returns three corresponding lists of booleans.
centerPoint = Custom[ZK.BoundingBox.CenterPoint](VARBoundingBox=byGeometry)  # Input Bounding Box element to get its center point. This node is little and lightweight, as it doesn't convert bounding box to geometry to get its centroid point.
byOriginNormal = Plane.ByOriginNormal(origin=centerPoint)
code_block_2 = CodeBlock { 2; }
scale = Geometry.Scale(geometry=filterByOrientation.VARhorizontalDown, plane=byOriginNormal, xamount=code_block_2, yamount=code_block_2)
thicken = Surface.Thicken(surface=flatten)
subtractFrom = Surface.SubtractFrom(surface=scale, trimmingEntity=thicken)
flatten_2 = List.Flatten(list=subtractFrom)
thicken_2 = Surface.Thicken(surface=flatten_2)
subtractFrom_2 = Surface.SubtractFrom(surface=byPatch@L2, trimmingEntity=thicken_2, lacing=Longest)
flatten_3 = List.Flatten(list=subtractFrom_2@L3)
python_script = Python(IN[0]=adaptive_family_orientation_type.VARPatternType, IN[1]=flatten, IN[2]=flatten_3)
# ---------- python_script.python (72 lines) ----------
# Enable Python support and load DesignScript library
# IMPORTANT : ALL DYNAMO DESIGN SCRIPT NODES ARE AS (dg)
import clr
clr.AddReference('ProtoGeometry')
from Autodesk.DesignScript import Geometry as dg

# EXTENSION Enable ToDSType
clr.AddReference('RevitNodes')
import Revit
clr.ImportExtensions(Revit.Elements)

# Enable Revit Elements
from Revit.Elements import *

# EXTENSION Enable Geometry Conversion Methods
clr.ImportExtensions(Revit.GeometryConversion)

# Enable Revit API
clr.AddReference('RevitAPI')
from Autodesk.Revit.DB import *

# Enable DocumentManager and TransactionManager
clr.AddReference('RevitServices')
from RevitServices.Persistence import DocumentManager
from RevitServices.Transactions import TransactionManager

# Enable ICollection List Translate
clr.AddReference("System")
import System.Collections.Generic
from System.Collections.Generic import List

def flatten(x):
    result = []
    for el in x:
        if hasattr(el, "__iter__") and not isinstance(el, basestring):
            result.extend(flatten(el))
        else:
            result.append(el)
    return result

dataEnteringNode = IN
# Use UnwrapElement(IN[0]) When Translating From Dynamo to Revit
allcondi=UnwrapElement(IN[0])
orgsurf=UnwrapElement(IN[1])
tosub=UnwrapElement(IN[2])

# Choose The Current Document
doc = DocumentManager.Instance.CurrentDBDocument
uidoc = DocumentManager.Instance.CurrentUIApplication.ActiveUIDocument
uiapp = DocumentManager.Instance.CurrentUIApplication
app = uiapp.Application

# Create Empty List
result = []
count = 0
for condi in allcondi:
	if condi == "Octagon" or condi == "OctagonRotate":
		try:
			tmp = []
			tmp.append(dg.Surface.Difference(orgsurf[count],tosub[count]).Surfaces())
			tmp.append(tosub[count])
			result.append(flatten(tmp))
		except:
			result.append(tosub[count])
	else:
		if len(tosub[count]) == 0:
			result.append([None])
		else:
			result.append(tosub[count])
	count += 1
# Assign your output to the OUT variable.
OUT = result
# ----------------------------------------
VARSurfaces_2 = Output(python_script)  # "VARSurfaces"
