# Dynamo custom node Group Curves By Surfaces.dyf (Dynamo 2.1.0.7500)
# category: Synthesize.Automate.Lines
# Group Curves By Surfaces

VARSurfaces = Input(VARSurfaces: var[]..[])
flatten = List.Flatten(list=VARSurfaces)
VARCurves = Input(VARCurves: var[]..[])
python_script = Python(IN[0]=flatten, IN[1]=VARCurves)
# ---------- python_script.python (77 lines) ----------
# Enable Python support and load DesignScript library
# IMPORTANT : ALL DYNAMO DESIGN SCRIPT NODES ARE AS (dg)
import clr
clr.AddReference('ProtoGeometry')
from Autodesk.DesignScript import Geometry as dg

# EXTENSION Enable ToDSType
clr.AddReference('RevitNodes')
import Revit
clr.ImportExtensions(Revit.Elements)

# Enable Revit Elements
from Revit.Elements import *

# EXTENSION Enable Geometry Conversion Methods
clr.ImportExtensions(Revit.GeometryConversion)

# Enable Revit API
clr.AddReference('RevitAPI')
from Autodesk.Revit.DB import *

# Enable DocumentManager and TransactionManager
clr.AddReference('RevitServices')
from RevitServices.Persistence import DocumentManager
from RevitServices.Transactions import TransactionManager

# Enable ICollection List Translate
clr.AddReference("System")
import System.Collections.Generic
from System.Collections.Generic import List

dataEnteringNode = IN
# Use UnwrapElement(IN[0]) When Translating From Dynamo to Revit
surfs=UnwrapElement(IN[0])
lines=UnwrapElement(IN[1])

# Choose The Current Document
doc = DocumentManager.Instance.CurrentDBDocument
uidoc = DocumentManager.Instance.CurrentUIApplication.ActiveUIDocument
uiapp = DocumentManager.Instance.CurrentUIApplication
app = uiapp.Application

# Create Empty List
result = []

pts = []
goodlines = []
for l in lines:
	try:
		pts.append(dg.Curve.PointAtParameter(l,0.5))
		goodlines.append(l)
	except:
		pass

interects = []
excluded = []
finalsurfs = []
for s in surfs:
	counter = 0
	tmp = []
	for p in pts:
		try:
			if dg.Geometry.DoesIntersect(s,p) and counter not in excluded:
				tmp.append(goodlines[counter])
				excluded.append(counter)
			counter += 1
		except:
			pass
	if len(tmp) != 0:
		interects.append(tmp)
		finalsurfs.append(s)
	else:
		interects.append([None])
		finalsurfs.append(s)

# Assign your output to the OUT variable.
OUT = finalsurfs,interects
# ----------------------------------------
code_block = CodeBlock(a=python_script) { a[0]; a[1]; }
VARSurfaces_2 = Output(code_block.out0)  # "VARSurfaces"
VARCurves_2 = Output(code_block.out1)  # "VARCurves"
