# Dynamo custom node Group Family Editor Elements By Volumes.dyf (Dynamo 2.1.0.7500)
# category: Synthesize.Automate.Family
# Group Family Editor Elements By Volumes

VARElements = Input(VARElements: var[]..[])
VARRounding = Input(VARRounding: double = 10)
python_script = Python(IN[0]=VARElements, IN[1]=VARRounding)
# ---------- python_script.python (147 lines) ----------
# Enable Python support and load DesignScript library
# IMPORTANT : ALL DYNAMO DESIGN SCRIPT NODES ARE AS (dg)
import clr
clr.AddReference('ProtoGeometry')
from Autodesk.DesignScript import Geometry as dg

# Import Math
import math

# EXTENSION Enable ToDSType
clr.AddReference('RevitNodes')
import Revit
clr.ImportExtensions(Revit.Elements)

# Enable Revit API
clr.AddReference('RevitAPI')
from Autodesk.Revit.DB import *

# Enable DocumentManager and TransactionManager
clr.AddReference('RevitServices')
from RevitServices.Persistence import DocumentManager
from RevitServices.Transactions import TransactionManager

# Choose The Current Document
doc = DocumentManager.Instance.CurrentDBDocument
uidoc = DocumentManager.Instance.CurrentUIApplication.ActiveUIDocument
uiapp = DocumentManager.Instance.CurrentUIApplication
app = uiapp.Application

# Simple Warning Swallow Class
class WarnSwallowSimple(IFailuresPreprocessor):
	def PreprocessFailures(self, failuresAccessor):
		failuresAccessor.DeleteAllWarnings()
		return FailureProcessingResult.Continue

def flatten(x):
    result = []
    for el in x:
        if hasattr(el, "__iter__") and not isinstance(el, basestring):
            result.extend(flatten(el))
        else:
            result.append(el)
    return result

def tolist(obj1):
	if hasattr(obj1,'__iter__'): return obj1
	else: return [obj1]

def totalvolume(doc,elem,mat_fec,rounding):
	totalvolume = []
	mats = elem.GetMaterialIds(False)
	if len(mats) == 0:
		mat = matcreateorget(mat_fec,"Default")
		param = elem.get_Parameter(BuiltInParameter.MATERIAL_ID_PARAM)
		try:
			param.Set(mat)
			doc.Regenerate()
			mats = elem.GetMaterialIds(False)
		except:
			if doc.FamilyManager.CanElementParameterBeAssociated(param):
				doc.FamilyManager.AssociateElementParameterToFamilyParameter(param, None)
				param.Set(mat)
				doc.Regenerate()
				mats = elem.GetMaterialIds(False)
	for m in mats:
		matvol = cusround(elem.GetMaterialVolume(m),rounding)
		if matvol == 0:
			matvol = cusround(elem.GetMaterialArea(m,False),rounding)
		if matvol == 0:
			matvol = cusround(elem.GetMaterialArea(m,True),rounding)
		totalvolume.append(matvol)
	totalvolume = sum(totalvolume)
	return totalvolume
	
def matcreateorget(mat_fec,material):
	fam_mat = False
	for m in mat_fec:
		if m.Name.lower() == material.lower():
			fam_mat = m.Id
			break
	if fam_mat == False:
		newmat = Material.Create(doc, material)
		defcolor = Color(120,120,120)
		matelement = doc.GetElement(newmat)
		matelement.Color = defcolor
		if "transparen" in material.lower():
			matelement.Transparency = 50
		fam_mat = newmat
	return fam_mat

def unique(myList):
	tmplist = []
	for m in myList:
		if m != "":
			tmplist.append(m)
	myList = tmplist
	uniqueList = []
	for item in myList :
		itemExist = False
		for x in uniqueList :
			if x == item :
				itemExist = True
				break
		if not itemExist :
			uniqueList.append(item)
	return uniqueList

def cusround(x,rounding):
    return int(round(x /rounding)) * rounding


elements=UnwrapElement(flatten(tolist(IN[0])))
rounding=IN[1]

mat_fec = FilteredElementCollector(doc).OfClass(Material)

TransactionManager.Instance.ForceCloseTransaction()
trans1 = Transaction(doc, 'Getting Volumes')
trans1.Start()
warnhandle = WarnSwallowSimple()
foptions = trans1.GetFailureHandlingOptions()
foptions.SetFailuresPreprocessor(warnhandle)
trans1.SetFailureHandlingOptions(foptions)

volumes = []
for elem in elements:
	try:
		volumes.append(totalvolume(doc,elem,mat_fec,rounding))
	except:
		volumes.append(0)

trans1.RollBack()

sortsource = sorted(unique(volumes))
groups = []
for s in sortsource:
	tmp = []
	count = 0
	for vol in volumes:
		elem = elements[count]
		if vol == s:
			tmp.append(elem)
		count += 1
	groups.append(tmp)
	
# Assign your output to the OUT variable.
OUT = groups
# ----------------------------------------
VARGroupedElements = Output(python_script)
