# Dynamo custom node Group Files By Prefix.dyf (Dynamo 2.1.0.7500)
# category: Synthesize.Automate.List
# Group Files By Prefix Separator

VARSeparator = Input(VARSeparator: string = "_")
VARFileNames = Input(VARFileNames: var[]..[])
VARFilePaths = Input(VARFilePaths: var[]..[])
python_script = Python(IN[0]=VARSeparator, IN[1]=VARFileNames, IN[2]=VARFilePaths)
# ---------- python_script.python (29 lines) ----------
separator = IN[0]
names = IN[1]
allfiles = IN[2]

def groupByPrefix(strings,allfiles,separator):
    stringsByPrefix = {}
    count = 0
    for string in strings:
            prefix, suffix = map(str.strip, string.split(separator, 1))
            group = stringsByPrefix.setdefault(prefix, [])
            group.append(allfiles[count])
            count += 1
    return stringsByPrefix


groupedfiles = groupByPrefix(names,allfiles,separator)

keys = groupedfiles.keys()
values = []
filenames = []
for k in keys:
	value = groupedfiles.get(k)
	values.append(value)
	tmp = []
	for v in value:
		tmp.append(v.split("\\")[-1])
	filenames.append(tmp)

OUT = keys,values,filenames
# ----------------------------------------
code_block = CodeBlock(a=python_script) { a[0]; a[1]; a[2]; }
VARKeys = Output(code_block.out0)
VARGroupedPaths = Output(code_block.out1)
VARFileNames_2 = Output(code_block.out2)  # "VARFileNames"
