# Dynamo custom node GroupModelLines.dyf (Dynamo 2.6.2.15705)
# category: Synthesize.Automate.Lines
# GroupModelLines

VARModelLines = Input(VARModelLines: var[]..[])
VAREquivalentCurves = Input(VAREquivalentCurves: var[]..[])
python_script = Python(IN[0]=VARModelLines, IN[1]=VAREquivalentCurves)
# ---------- python_script.python (119 lines) ----------
# Enable Python support and load DesignScript library
# IMPORTANT : ALL DYNAMO DESIGN SCRIPT NODES ARE AS (dg)
import clr
clr.AddReference('ProtoGeometry')
from Autodesk.DesignScript import Geometry as dg

# EXTENSION Enable ToDSType
clr.AddReference('RevitNodes')
import Revit
clr.ImportExtensions(Revit.Elements)

# Enable Revit Elements
from Revit.Elements import *

# EXTENSION Enable Geometry Conversion Methods
clr.ImportExtensions(Revit.GeometryConversion)

# Enable Revit API
clr.AddReference('RevitAPI')
from Autodesk.Revit.DB import *

# Enable DocumentManager and TransactionManager
clr.AddReference('RevitServices')
from RevitServices.Persistence import DocumentManager
from RevitServices.Transactions import TransactionManager

# Enable ICollection List Translate
clr.AddReference("System")
import System.Collections.Generic
from System.Collections.Generic import List

import math

dataEnteringNode = IN
# Use UnwrapElement(IN[0]) When Translating From Dynamo to Revit
modelCurves=UnwrapElement(IN[0])
crvs=IN[1]

# Choose The Current Document
doc = DocumentManager.Instance.CurrentDBDocument
uidoc = DocumentManager.Instance.CurrentUIApplication.ActiveUIDocument
uiapp = DocumentManager.Instance.CurrentUIApplication
app = uiapp.Application

def tolist(obj1):
	if hasattr(obj1,'__iter__'): return obj1
	else: return [obj1]

def flatten(x):
    result = []
    for el in x:
        if hasattr(el, "__iter__") and not isinstance(el, basestring):
            result.extend(flatten(el))
        else:
            result.append(el)
    return result

def joincurves(crvs,modelcurves):
	def PointsEqual(pt1, pt2):
		tolerance = 0.00001
		if (math.fabs(pt1.X - pt2.X) < tolerance and
			math.fabs(pt1.Y - pt2.Y) < tolerance and
			math.fabs(pt1.Z - pt2.Z) < tolerance):
			return True
		else:
			return False
	crvs = flatten(tolist(crvs))
	crvGroup = [-1 for x in range(len(crvs))]
	crvGroup[0] = 0
	maxGroupNum = 1
	starts = []
	ends = []
	for crv in crvs:
		starts.append(crv.PointAtParameter(0))
		ends.append(crv.PointAtParameter(1))
	for i in range(len(crvs)):
		if (crvGroup[i] == -1):
			crvGroup[i] = i
		for j in range(len(crvs)):
			if (i != j and
				(PointsEqual(starts[i], starts[j]) or
				PointsEqual(starts[i], ends[j]) or
				PointsEqual(ends[i], starts[j]) or
				PointsEqual(ends[i], ends[j]))):
				if (crvGroup[j] == -1):
					crvGroup[j] = crvGroup[i]
				elif (crvGroup[i] != crvGroup[j]):
					oldNum = crvGroup[j]
					for k in range(len(crvs)):
						if (crvGroup[k] == oldNum):
							crvGroup[k] = crvGroup[i]
	groups = []
	groupsModel = []
	excluded = []
	for n in crvGroup:
		innercount = 0
		tmp = []
		tmpModel = []
		for n2 in crvGroup:
			if n == n2 and n2 not in excluded:
				tmp.append(crvs[innercount])
				tmpModel.append(modelcurves[innercount])
			innercount += 1
		if len(tmp) == 0:
			continue
		try:
			tmp = dg.PolyCurve.ByJoinedCurves(tmp,0.001)
			groups.append(tmp)
			groupsModel.append(tmpModel)
		except:
			for t in tmp:
				groups.append(dg.PolyCurve.ByJoinedCurves([t],0.001))
			groupsModel.append(tmpModel)
		excluded.append(n)
	joinedcurves = groups
	joinedModel = groupsModel
	return joinedcurves,joinedModel
#Assign your output to the OUT variable.
OUT = joincurves(crvs,modelCurves)
# ----------------------------------------
code_block = CodeBlock(a=python_script) { a[0]; a[1]; }
VARJoinedCurves = Output(code_block.out0)
VARGroupedModelLines = Output(code_block.out1)
