# Dynamo custom node Groups Batch Placement.dyf (Dynamo 2.1.0.7500)
# category: Synthesize.Automate.Links
# Revit Links Batch Placement

VARgroupType = Input(VARgroupType: var[]..[])
VARLocations = Input(VARLocations: var[]..[])
VARRotations = Input(VARRotations: var[]..[])
python_script = Python(IN[0]=VARgroupType, IN[1]=VARLocations, IN[2]=VARRotations)
# ---------- python_script.python (56 lines) ----------
# Enable Python support and load DesignScript library
# IMPORTANT : ALL DYNAMO DESIGN SCRIPT NODES ARE AS (dg)
import clr
clr.AddReference('ProtoGeometry')
from Autodesk.DesignScript import Geometry as dg

# EXTENSION Enable ToDSType
clr.AddReference('RevitNodes')
import Revit
clr.ImportExtensions(Revit.Elements)

# Enable Revit Elements
from Revit.Elements import *

# EXTENSION Enable Geometry Conversion Methods
clr.ImportExtensions(Revit.GeometryConversion)

# Enable Revit API
clr.AddReference('RevitAPI')
from Autodesk.Revit.DB import *

# Enable DocumentManager and TransactionManager
clr.AddReference('RevitServices')
from RevitServices.Persistence import DocumentManager
from RevitServices.Transactions import TransactionManager

# Enable ICollection List Translate
clr.AddReference("System")
import System.Collections.Generic
from System.Collections.Generic import List

import math

doc = DocumentManager.Instance.CurrentDBDocument
groupType = UnwrapElement(IN[0])
location = IN[1]
rotations = IN[2]
xyz = []
result = []

for e in location:
	xyz.append(e.ToXyz())
	
TransactionManager.Instance.EnsureInTransaction(doc)


for eachpoint in xyz:
	groupInstance = doc.Create.PlaceGroup(eachpoint, groupType)
	instanceid = groupInstance.Id
	axis = Line.CreateBound(eachpoint, XYZ(eachpoint.X,eachpoint.Y,eachpoint.Z +1))
	ElementTransformUtils.RotateElement(doc,instanceid,axis,rotations[xyz.index(eachpoint)]*math.pi/-180)
	result.append(groupInstance)

TransactionManager.Instance.TransactionTaskDone()

OUT = result
# ----------------------------------------
VARGroupInstance = Output(python_script)
