# Dynamo custom node Groups Batch Rotation.dyf (Dynamo 2.1.0.7500)
# category: Synthesize.Automate.Links
# Revit Links Batch Placement

VARGroupInstance = Input(VARGroupInstance: var[]..[])
VARRotations = Input(VARRotations: var[]..[])
python_script = Python(IN[0]=VARGroupInstance, IN[1]=VARRotations)
# ---------- python_script.python (61 lines) ----------
# Enable Python support and load DesignScript library
# IMPORTANT : ALL DYNAMO DESIGN SCRIPT NODES ARE AS (dg)
import clr
clr.AddReference('ProtoGeometry')
from Autodesk.DesignScript import Geometry as dg

# EXTENSION Enable ToDSType
clr.AddReference('RevitNodes')
import Revit
clr.ImportExtensions(Revit.Elements)

# Enable Revit Elements
from Revit.Elements import *

# EXTENSION Enable Geometry Conversion Methods
clr.ImportExtensions(Revit.GeometryConversion)

# Enable Revit API
clr.AddReference('RevitAPI')
from Autodesk.Revit.DB import *

# Enable DocumentManager and TransactionManager
clr.AddReference('RevitServices')
from RevitServices.Persistence import DocumentManager
from RevitServices.Transactions import TransactionManager

# Enable ICollection List Translate
clr.AddReference("System")
import System.Collections.Generic
from System.Collections.Generic import List
import math

def tolist(obj1):
	if hasattr(obj1,'__iter__'): return obj1
	else: return [obj1]

doc = DocumentManager.Instance.CurrentDBDocument
groupInstances = UnwrapElement(tolist(IN[0]))
rotations = tolist(IN[1])
result = []

TransactionManager.Instance.EnsureInTransaction(doc)

count = 0
for groupInstance in groupInstances:
	instanceid = groupInstance.Id
	eachpoint = groupInstance.Location.Point
	axis = Line.CreateBound(eachpoint, XYZ(eachpoint.X,eachpoint.Y,eachpoint.Z +1))
	try:
		groupInstance.Location.Rotate(axis,rotations[count]*math.pi/-180)
	except:
		try:
			ElementTransformUtils.RotateElement(doc,instanceid,axis,rotations[count]*math.pi/-180)
		except:
			pass
	result.append(groupInstance)
	count += 1

TransactionManager.Instance.TransactionTaskDone()

OUT = result
# ----------------------------------------
VARGroupInstance_2 = Output(python_script)  # "VARGroupInstance"
