# Dynamo custom node HOT.AllowDisallowWallJoinAtEnd.dyf (Dynamo 2.1.0.7500)
# category: Synthesize.Packages.Hot Gear.Geometry Join
# Allow/Disallow Wall Join At End.
# True=Allow.WallJoinAtEnd
# False=Disallow.WallJoinAtEnd

VARElements = Input(VARElements: var[]..[])
python_script = Python(IN[0]=VARElements)
# ---------- python_script.python (33 lines) ----------
import clr

clr.AddReference("RevitAPI")
import Autodesk
from Autodesk.Revit.DB import *

clr.AddReference("RevitServices")
import RevitServices
from RevitServices.Persistence import DocumentManager
from RevitServices.Transactions import TransactionManager

clr.AddReference("RevitNodes")
import Revit
clr.ImportExtensions(Revit.Elements)
clr.ImportExtensions(Revit.GeometryConversion)

import clr
clr.AddReference('ProtoGeometry')
from Autodesk.DesignScript.Geometry import *

doc =  DocumentManager.Instance.CurrentDBDocument
app =  DocumentManager.Instance.CurrentUIApplication.Application

elements = UnwrapElement(IN[0])

output = []
catname = []

for item in elements:
	catname.append(item.Category.Name)
	output.append(catname)

OUT = output
# ----------------------------------------
flatten = List.Flatten(list=python_script)
code_block = CodeBlock { "Walls"; }
eq = flatten == code_block
filterByBoolMask = List.FilterByBoolMask(list=VARElements, mask=eq)
VARBool = Input(VARBool: var[]..[])
code_block_2 = CodeBlock(lsit=VARBool) { Flatten([lsit]); }
python_script_2 = Python(IN[0]=filterByBoolMask.in, IN[1]=code_block_2)
# ---------- python_script_2.python (59 lines) ----------
import clr
clr.AddReference('ProtoGeometry')
from Autodesk.DesignScript.Geometry import *

clr.AddReference("RevitAPI")
import Autodesk
from Autodesk.Revit.DB import *

clr.AddReference("RevitServices")
import RevitServices
from RevitServices.Persistence import DocumentManager
from RevitServices.Transactions import TransactionManager
from System.Collections.Generic import *

clr.AddReference("RevitNodes")
import Revit
clr.ImportExtensions(Revit.Elements)

doc = DocumentManager.Instance.CurrentDBDocument

elements = UnwrapElement(IN[0])
TF = IN[1]
beginning = 0
ending = 0
result = []
TransactionManager.Instance.EnsureInTransaction(doc)
if TF[0] == True:
	while (beginning < len(elements)):
		try:
			Autodesk.Revit.DB.WallUtils.AllowWallJoinAtEnd(elements[beginning], 0)
			beginning = beginning + 1
			result.append("Success")
		except:
			beginning = beginning + 1
	while (ending < len(elements)):
		try:
			Autodesk.Revit.DB.WallUtils.AllowWallJoinAtEnd(elements[ending], 1)
			ending = ending + 1
			result.append("Success")
		except:
			ending = ending + 1
elif TF[0] == False:
	while (beginning < len(elements)):
		try:
			Autodesk.Revit.DB.WallUtils.DisallowWallJoinAtEnd(elements[beginning], 0)
			beginning = beginning + 1
			result.append("Success")
		except:
			beginning = beginning + 1
	while (ending < len(elements)):
		try:
			Autodesk.Revit.DB.WallUtils.DisallowWallJoinAtEnd(elements[ending], 1)
			ending = ending + 1
			result.append("Success")
		except:
			ending = ending + 1
TransactionManager.Instance.TransactionTaskDone()

OUT = result , elements
# ----------------------------------------
code_block_3 = CodeBlock(x=python_script_2) { x[0]; x[1]; }
VARElements_2 = Output(code_block_3.out1)  # "VARElements"
VARResult = Output(code_block_3.out0)
