# Dynamo custom node HOT.Get Active View Filter.dyf (Dynamo 2.1.0.7500)
# category: Synthesize.Packages.Hot Gear.View
# Get all Filter

python_script = Python()
# ---------- python_script.python (53 lines) ----------
# Created By Karam Baki : karam@aecedx.com
# Enable Python support and load DesignScript library
# IMPORTANT : ALL DYNAMO DESIGN SCRIPT NODES ARE AS (dg)
import clr
import math
clr.AddReference('ProtoGeometry')
from Autodesk.DesignScript import Geometry as dg

# EXTENSION Enable ToDSType
clr.AddReference('RevitNodes')
import Revit
clr.ImportExtensions(Revit.Elements)

# Enable Revit Elements
from Revit.Elements import *

# EXTENSION Enable Geometry Conversion Methods
clr.ImportExtensions(Revit.GeometryConversion)

# Enable Revit API
clr.AddReference('RevitAPI')
from Autodesk.Revit.DB import *

# Enable DocumentManager and TransactionManager
clr.AddReference('RevitServices')
from RevitServices.Persistence import DocumentManager
from RevitServices.Transactions import TransactionManager

# Enable ICollection List Translate
clr.AddReference("System")
import System.Collections.Generic
from System.Collections.Generic import List
from itertools import compress
#The inputs to this node will be stored as a list in the IN variables.

doc = DocumentManager.Instance.CurrentDBDocument
uidoc = DocumentManager.Instance.CurrentUIApplication.ActiveUIDocument
uiapp = DocumentManager.Instance.CurrentUIApplication
app = uiapp.Application

#result=[]
active = uidoc.ActiveView

filterstoget = active.GetFilters()

elements = []
names = []
for each in filterstoget:
	elem = doc.GetElement(each)
	elements.append(elem)
	names.append(elem.Name)

OUT = elements, filterstoget, names
# ----------------------------------------
code_block = CodeBlock(res=python_script) { res[0]; res[1]; res[2]; }
VARElement = Output(code_block.out0)
VARId = Output(code_block.out1)
VARName = Output(code_block.out2)
