# Dynamo custom node HOT.Get All Filter.dyf (Dynamo 2.1.0.7500)
# category: Synthesize.Packages.Hot Gear.View
# Get all Filter

python_script = Python()
# ---------- python_script.python (32 lines) ----------
import clr
clr.AddReference('ProtoGeometry')
from Autodesk.DesignScript.Geometry import *

# Import DocumentManager and TransactionManager
clr.AddReference("RevitServices")
import RevitServices
from RevitServices.Persistence import DocumentManager
from RevitServices.Transactions import TransactionManager

# Import RevitAPI
clr.AddReference("RevitAPI")
import Autodesk
from Autodesk.Revit.DB import *

doc = DocumentManager.Instance.CurrentDBDocument

from System.Collections.Generic import *

# Import ToDSType(bool) extension method
clr.AddReference("RevitNodes")
import Revit
clr.ImportExtensions(Revit.Elements)

#collect all views in the model
collector = FilteredElementCollector(doc)
views = collector.OfClass(FilterElement).ToElements()

view = []
for i in views:
	view.append(i.ToDSType(True))
OUT = view
# ----------------------------------------
VARElement = Output(python_script)
hot_revit_id = Custom[HOT.Revit ID](VARElements=python_script)
flatten = List.Flatten(list=hot_revit_id.VARRevitID)
VARId = Output(flatten)
name = Element.Name(element=python_script)
VARName = Output(name)
