# Dynamo custom node HOT.Index of item.dyf (Dynamo 2.1.0.7500)
# category: Synthesize.Packages.Hot Gear.List
# Index of Item on List

VARList = Input(VARList: var[]..[])
VARItem = Input(VARItem: var[]..[])
python_script = Python(IN[0]=VARList, IN[1]=VARItem)
# ---------- python_script.python (19 lines) ----------
import clr
clr.AddReference('ProtoGeometry')
from Autodesk.DesignScript.Geometry import *
#The inputs to this node will be stored as a list in the IN variable.

list1=IN[0]
member=IN[1]
cnt=len(list1)
inx=0
indices=[]

while inx<cnt :
	if list1[inx]==member:
		indices.append(inx)
	inx=inx+1

#Assign your output to the OUT variable

OUT = indices
# ----------------------------------------
VARIndex = Output(python_script)
