# Dynamo custom node HOT.Join Type (Miter).dyf (Dynamo 2.1.0.7500)
# category: Synthesize.Packages.Hot Gear.Geometry Join

VARElementlist = Input(VARElementlist: var[]..[])
create = List.Create(item0=VARElementlist)
flatten = List.Flatten(list=create)
python_script = Python(IN[0]=flatten)
# ---------- python_script.python (33 lines) ----------
import clr
clr.AddReference("RevitAPI")
import Autodesk
from Autodesk.Revit.DB import *

clr.AddReference("RevitServices")
import RevitServices
from RevitServices.Persistence import DocumentManager
from RevitServices.Transactions import TransactionManager
from System.Collections.Generic import *

clr.AddReference("RevitNodes")
import Revit
clr.ImportExtensions(Revit.Elements)

doc = DocumentManager.Instance.CurrentDBDocument

walls = []
for i in IN[0]:
	walls.append((UnwrapElement(i)).Location)

TransactionManager.Instance.EnsureInTransaction(doc)
for j in walls:
	j.set_JoinType(0,JoinType.Miter)
	
for j in walls:
	j.set_JoinType(1,JoinType.Miter)
TransactionManager.Instance.TransactionTaskDone()

if j.get_JoinType(0) == JoinType.Miter or j.get_JoinType(1) == JoinType.Miter:
	OUT = "Success"
else:
	OUT = False
# ----------------------------------------
VARSuccess = Output(python_script)
