# Dynamo custom node HOT.View Set Filter Visibility.dyf (Dynamo 2.1.0.7500)
# category: Synthesize.Packages.Hot Gear.View
# Set View Filter Visibility

VARView = Input(VARView: var[]..[])
VARFilterId = Input(VARFilterId: var[]..[])
code_block = CodeBlock(list=VARFilterId) { DSCore.List.Flatten([list]); }
VARVisibility = Input(VARVisibility: var[]..[])
code_block_2 = CodeBlock(list=VARVisibility) { DSCore.List.Flatten([list]); }
python_script = Python(IN[0]=VARView, IN[1]=code_block, IN[2]=code_block_2)
# ---------- python_script.python (41 lines) ----------
import clr
clr.AddReference('ProtoGeometry')
from Autodesk.DesignScript.Geometry import *

clr.AddReference('RevitAPI')
from Autodesk.Revit.DB import *

clr.AddReference("RevitNodes")
import Revit
clr.ImportExtensions(Revit.Elements)

clr.AddReference("RevitServices")
import RevitServices
from RevitServices.Persistence import DocumentManager
from RevitServices.Transactions import TransactionManager

doc = DocumentManager.Instance.CurrentDBDocument

view = UnwrapElement(IN[0])
filterid = IN[1]
visibility = IN[2]
result = []
count = 0

if len(filterid) == 0:
	pass
else:
	TransactionManager.Instance.EnsureInTransaction(doc)
	while (count < len(visibility)):
		for i in filterid:
			try:
				view.SetFilterVisibility(i, visibility[count])
				result.append(view)
				count
				count = count + 1
			except:
				view.SetFilterVisibility(i, visibility[count-1])
				result.append(view)
	TransactionManager.Instance.TransactionTaskDone()

OUT = result
# ----------------------------------------
VAROUT = Output(python_script)
