# Dynamo custom node Helix to Curves.dyf (Dynamo 2.1.0.7500)
# category: Synthesize.Automate.Lines
# Helix to Curves

VARHelixElements = Input(VARHelixElements: var[]..[])
python_script = Python(IN[0]=VARHelixElements)
# ---------- python_script.python (74 lines) ----------
# Enable Python support and load DesignScript library
# IMPORTANT : ALL DYNAMO DESIGN SCRIPT NODES ARE AS (dg)
import clr
clr.AddReference('ProtoGeometry')
from Autodesk.DesignScript import Geometry as dg

# EXTENSION Enable ToDSType
clr.AddReference('RevitNodes')
import Revit
clr.ImportExtensions(Revit.Elements)

# Enable Revit Elements
from Revit.Elements import *

# EXTENSION Enable Geometry Conversion Methods
clr.ImportExtensions(Revit.GeometryConversion)

# Enable Revit API
clr.AddReference('RevitAPI')
from Autodesk.Revit.DB import *

# Enable DocumentManager and TransactionManager
clr.AddReference('RevitServices')
from RevitServices.Persistence import DocumentManager
from RevitServices.Transactions import TransactionManager

# Enable ICollection List Translate
clr.AddReference("System")
import System.Collections.Generic
from System.Collections.Generic import List

dataEnteringNode = IN
# Use UnwrapElement(IN[0]) When Translating From Dynamo to Revit

# Choose The Current Document
doc = DocumentManager.Instance.CurrentDBDocument
uidoc = DocumentManager.Instance.CurrentUIApplication.ActiveUIDocument
uiapp = DocumentManager.Instance.CurrentUIApplication
app = uiapp.Application

def tolist(obj1):
	if hasattr(obj1,'__iter__'): return obj1
	else: return [obj1]

dataEnteringNode = IN
# Use UnwrapElement(IN[0]) When Translating From Dynamo to Revit
curvesbypoints=UnwrapElement(tolist(IN[0]))

# Choose The Current Document
doc = DocumentManager.Instance.CurrentDBDocument
uidoc = DocumentManager.Instance.CurrentUIApplication.ActiveUIDocument
uiapp = DocumentManager.Instance.CurrentUIApplication
app = uiapp.Application

# Create Empty List
result = []
for e in curvesbypoints:
	try:
		try:
			conv = e.GeometryCurve
		except:
			conv = e
		if conv.ToString() != "Autodesk.Revit.DB.CylindricalHelix":
			result.append(conv.ToProtoType())
		else:
			tess = conv.Tessellate()
			tmp = []
			for s in tess:
				tmp.append(s.ToPoint())
			result.append(dg.NurbsCurve.ByPoints(tmp))
	except:
		result.append(None)

OUT =  result
# ----------------------------------------
VARCurves = Output(python_script)
