# Dynamo custom node HelixAtCurve.dyf (Dynamo 2.1.0.7500)
# category: Synthesize.Packages.EnjoyRevit

# group: Thanks to HyunWoo
VARStartAngle = Input(VARStartAngle: var[]..[])
VARTurnAngle = Input(VARTurnAngle: var[]..[])
code_block = CodeBlock(startangle=VARStartAngle, turnangle=VARTurnAngle) { startangle..startangle+turnangle..#12*turnangle/360+1; }
sin = Math.Sin(angle=code_block)
VARStartRadius = Input(VARStartRadius: var[]..[])
VAREndRadius = Input(VAREndRadius: var[]..[])
code_block_2 = CodeBlock(start=VARStartRadius, end=VAREndRadius, trunangle=VARTurnAngle) { start..end..#12*trunangle/360+1; }
mul = sin * code_block_2
cos = Math.Cos(angle=code_block)
mul_2 = cos * code_block_2
byCoordinates = Point.ByCoordinates(x=mul, y=mul_2)
VARcurve = Input(VARcurve: var[]..[])
VARStartParameter = Input(VARStartParameter: var[]..[])
VAREndParameter = Input(VAREndParameter: var[]..[])
code_block_3 = CodeBlock(start=VARStartParameter, end=VAREndParameter, turnangle=VARTurnAngle) { start..end..#12*turnangle/360+1; }
planeAtParameter = Curve.PlaneAtParameter(curve=VARcurve, param=code_block_3)
byPlane = CoordinateSystem.ByPlane(plane=planeAtParameter)
transform = Geometry.Transform(geometry=byCoordinates, cs=byPlane)
byPoints = NurbsCurve.ByPoints(points=transform)
VARNurbsCurve = Output(byPoints)
