# Dynamo custom node Hot.Dynamo Color to Revit Color.dyf (Dynamo 2.1.0.7500)
# category: Synthesize.Packages.Hot Gear.Python

VAR = Input(VAR: var[]..[])
red = Color.Red(color=VAR)
green = Color.Green(color=VAR)
blue = Color.Blue(color=VAR)
python_script = Python(IN[0]=red, IN[1]=green, IN[2]=blue)
# ---------- python_script.python (21 lines) ----------
import clr
clr.AddReference('ProtoGeometry')
from Autodesk.DesignScript.Geometry import *

clr.AddReference('RevitAPI')
from Autodesk.Revit.DB import *

clr.AddReference("RevitNodes")
import Revit
clr.ImportExtensions(Revit.Elements)

clr.AddReference("RevitServices")
import RevitServices
from RevitServices.Persistence import DocumentManager
from RevitServices.Transactions import TransactionManager

doc = DocumentManager.Instance.CurrentDBDocument

color = Color(IN[0],IN[1],IN[2])

OUT = color
# ----------------------------------------
VAR_2 = Output(python_script)  # "VAR"
