# Dynamo custom node Hot.View Set Filter Overrides.dyf (Dynamo 2.1.0.7500)
# category: Synthesize.Packages.Hot Gear.OverrideGraphicSettings

VARView = Input(VARView: var[]..[])
VARFilterID = Input(VARFilterID: var[]..[])
code_block = CodeBlock(list=VARFilterID) { DSCore.List.Flatten([list]); }
VAR = Input(VAR: var[]..[])
code_block_2 = CodeBlock(list=VAR) { DSCore.List.Flatten([list]); }
python_script = Python(IN[0]=VARView, IN[1]=code_block, IN[2]=code_block_2)
# ---------- python_script.python (39 lines) ----------
import clr
clr.AddReference('ProtoGeometry')
from Autodesk.DesignScript.Geometry import *

clr.AddReference('RevitAPI')
from Autodesk.Revit.DB import *

clr.AddReference("RevitNodes")
import Revit
clr.ImportExtensions(Revit.Elements)

clr.AddReference("RevitServices")
import RevitServices
from RevitServices.Persistence import DocumentManager
from RevitServices.Transactions import TransactionManager

doc = DocumentManager.Instance.CurrentDBDocument

view = UnwrapElement(IN[0])
filters = IN[1]
override = IN[2]
result = []
count = 0

TransactionManager.Instance.EnsureInTransaction(doc)
while (count < len(override)):
	for i in filters:
		try:
			view.SetFilterOverrides(i, override[count])
			result.append("Success")
			count
			count = count + 1
		except:
			view.SetFilterOverrides(i, override[count-1])
			result.append("Success")
TransactionManager.Instance.TransactionTaskDone()


OUT = result
# ----------------------------------------
VARResult = Output(python_script)
