# Dynamo custom node Join Single Element With Surroundings.dyf (Dynamo 2.1.0.7500)
# category: Synthesize.Automate.Join
# Join Single Element With Surroundings

VARSwitchJoinOrderofAlreadyJoinedElement = Input(VARSwitchJoinOrderofAlreadyJoinedElements: var[]..[])
VARIncludeWallsWithWalls = Input(VARIncludeWallsWithWalls: var[]..[])
join = List.Join()  # unwired: list0, list1
VARElement = Input(VARElement: var[]..[])
turnIntoList = Custom[CW.TurnIntoList](VARunknownItem=VARElement)  # Turns an element (or a nested list) into a flat list
python_all_elements_in_active = Custom[Python All Elements In Active View]()  # Python All Elements In Active View
flatten = List.Flatten(list=python_all_elements_in_active)
string = StringInput("""Ceilings
Columns
Floors
Floors - Slab Edges
Generic Models
Mass
Roofs
Roofs - Fascias
Roofs - Gutters
Roofs - Roof Soffits
Structural Columns
Structural Foundations
Structural Framing
Walls
Walls - Wall Sweeps""")
code_block = CodeBlock()
# ---------- code_block.designscript (2 lines) ----------
"
";
# ----------------------------------------
split = String.Split(str=string, separator0=code_block)
getCategory = Element.GetCategory(element=flatten)
string_from_object = FromObject(obj=getCategory)
contains = List.Contains(list=split, item=string_from_object@@L1)
filterByBoolMask = List.FilterByBoolMask(list=flatten, mask=contains)
code_block_2 = CodeBlock { "Family"; "Family Name"; "Curtain Wall"; }
getParameterValueByName = Element.GetParameterValueByName(element=filterByBoolMask.in, parameterName=code_block_2.out0)
getParameterValueByName_2 = Element.GetParameterValueByName(element=getParameterValueByName, parameterName=code_block_2.out1)
eq = getParameterValueByName_2 == code_block_2.out2
anyTrue = Custom[CW.List.AnyTrue]()  # Returns true if any item in a list of booleans is true.; unwired: VARseq
map = List.Map(list=eq, f_x=anyTrue)
filterByBoolMask_2 = List.FilterByBoolMask(list=filterByBoolMask.in, mask=map)
boundingBox = Element.BoundingBox(element=filterByBoolMask_2.out)
isNull = Object.IsNull(obj=boundingBox)
filterByBoolMask_3 = List.FilterByBoolMask(list=filterByBoolMask_2.out, mask=isNull)
laceLongest = List.LaceLongest(comb=join, list1=turnIntoList, list2=filterByBoolMask_3.out)
string_from_object_2 = FromObject(obj=laceLongest)
code_block_3 = CodeBlock { "Wall"; }
eq_2 = string_from_object_2 == code_block_3
allTrue = List.AllTrue(list=eq_2@L2)
filterByBoolMask_4 = List.FilterByBoolMask(list=laceLongest, mask=allTrue)
scopeIf = Custom[CW.ScopeIf+](VARtest=VARIncludeWallsWithWalls, VARtrue=laceLongest, VARfalse=filterByBoolMask_4.out)  # A (hopefully) more robust implementation of ScopeIf. Tests a single boolean and returns a value accordingly.
boundingBox_2 = Element.BoundingBox(element=VARElement)
turnIntoList_2 = Custom[CW.TurnIntoList](VARunknownItem=boundingBox_2)
filterByBoolMask_5 = List.FilterByBoolMask(list=boundingBox, mask=isNull)
laceLongest_2 = List.LaceLongest(comb=join, list1=turnIntoList_2, list2=filterByBoolMask_5.out)
filterByBoolMask_6 = List.FilterByBoolMask(list=laceLongest_2, mask=allTrue)
scopeIf_2 = Custom[CW.ScopeIf+](VARtest=VARIncludeWallsWithWalls, VARtrue=laceLongest_2, VARfalse=filterByBoolMask_6.out)
firstItem = List.FirstItem(list=scopeIf_2@L2)
lastItem = List.LastItem(list=scopeIf_2@L2)
intersects = BoundingBox.Intersects(boundingBox=firstItem, other=lastItem)
filterByBoolMask_7 = List.FilterByBoolMask(list=scopeIf, mask=intersects)
python_script = Python(IN[0]=filterByBoolMask_7.in)
# ---------- python_script.python (34 lines) ----------
import clr
clr.AddReference('ProtoGeometry')
from Autodesk.DesignScript.Geometry import *

clr.AddReference("RevitAPI")
import Autodesk
from Autodesk.Revit.DB import *

clr.AddReference("RevitServices")
import RevitServices
from RevitServices.Persistence import DocumentManager
from RevitServices.Transactions import TransactionManager
from System.Collections.Generic import *

clr.AddReference("RevitNodes")
import Revit
clr.ImportExtensions(Revit.Elements)

doc = DocumentManager.Instance.CurrentDBDocument
TransactionManager.Instance.EnsureInTransaction(doc)

element = UnwrapElement(IN[0])

list = len(element)
count = 0
end = []

while (count < list):
		result = Autodesk.Revit.DB.JoinGeometryUtils.AreElementsJoined(doc, element[count][0], element[count][1])
		count = count + 1
		end.append(result)

TransactionManager.Instance.TransactionTaskDone()
OUT = end
# ----------------------------------------
filterByBoolMask_8 = List.FilterByBoolMask(list=filterByBoolMask_7.in, mask=python_script)
empty = List.Empty()
scopeIf_3 = Custom[CW.ScopeIf+](VARtest=VARSwitchJoinOrderofAlreadyJoinedElement, VARtrue=filterByBoolMask_8.in, VARfalse=empty)
python_script_2 = Python(IN[0]=scopeIf_3)
# ---------- python_script_2.python (34 lines) ----------
import clr
clr.AddReference('ProtoGeometry')
from Autodesk.DesignScript.Geometry import *

clr.AddReference("RevitAPI")
import Autodesk
from Autodesk.Revit.DB import *

clr.AddReference("RevitServices")
import RevitServices
from RevitServices.Persistence import DocumentManager
from RevitServices.Transactions import TransactionManager
from System.Collections.Generic import *

clr.AddReference("RevitNodes")
import Revit
clr.ImportExtensions(Revit.Elements)

doc = DocumentManager.Instance.CurrentDBDocument
TransactionManager.Instance.EnsureInTransaction(doc)

elements = UnwrapElement(IN[0])
count = 0
result = []
while (count < len(elements)):
	try:
		Autodesk.Revit.DB.JoinGeometryUtils.SwitchJoinOrder(doc, elements[count][0], elements[count][1])
		count = count + 1
		result.append("Success")
	except:
		count = count +1

TransactionManager.Instance.TransactionTaskDone()
OUT = result
# ----------------------------------------
VARTemporarilyIsolatePossibleToJoinEleme = Input(VARTemporarilyIsolatePossibleToJoinElements: var[]..[])
hot_get_revit_activeview = Custom[HOT.Get Revit ActiveView]()  # Active View
empty_2 = List.Empty()
scopeIf_4 = Custom[CW.ScopeIf+](VARtest=VARTemporarilyIsolatePossibleToJoinEleme, VARtrue=hot_get_revit_activeview, VARfalse=empty_2)
flatten_2 = List.Flatten(list=filterByBoolMask_8.out)
uniqueItems = List.UniqueItems(list=flatten_2)
scopeIf_5 = Custom[CW.ScopeIf+](VARtest=VARTemporarilyIsolatePossibleToJoinEleme, VARtrue=uniqueItems, VARfalse=empty_2)
temporarilyIsolateInView = Custom[CW.Element.TemporarilyIsolateInView](VARview=scopeIf_4, VARelement=scopeIf_5)  # (Temporarily) isolates elements in the given view
VARConsiderVolumetricRuleForJoiningMater = Input(VARConsiderVolumetricRuleForJoiningMaterialsMustBeAssigned: var[]..[])
code_block_4 = CodeBlock { null; }
scopeIf_6 = Custom[CW.ScopeIf+](VARtest=VARConsiderVolumetricRuleForJoiningMater, VARtrue=filterByBoolMask_8.out, VARfalse=code_block_4)
flatten_3 = List.Flatten(list=scopeIf_6)
uniqueItems_2 = List.UniqueItems(list=flatten_3)
code_block_5 = CodeBlock { 0; }
python_script_3 = Python(IN[0]=uniqueItems_2)
# ---------- python_script_3.python (12 lines) ----------
import clr
clr.AddReference('RevitAPI')
from Autodesk.Revit.DB import *

items = UnwrapElement(IN[0])
elementvols = list()
for item in items:
	vollist = list()
	for matid in item.GetMaterialIds(False):
		vollist.append(item.GetMaterialVolume(matid))
	elementvols.append(vollist)
OUT = (elementvols)
# ----------------------------------------
sum = Math.Sum(values=python_script_3@L2)
eq_3 = code_block_5 == sum
filterByBoolMask_9 = List.FilterByBoolMask(list=uniqueItems_2, mask=eq_3)
string_from_object_3 = FromObject(obj=filterByBoolMask_9.in)
as_list_groupbykey = Custom[AS.[&] List.GroupByKey](VARobjectList=filterByBoolMask_9.in, VARkeys=string_from_object_3)  # Sort the items of a list into groups (sublists) based on the corresponding items of a reference list. Example: The list {A,B,C,D,E} with the reference list {1,anyWord,4,anyWord,1} will be grouped into lists as { {A,E}, {B,D}, {C} } and the unique references will be {1, anyWord, 4}.
id = Element.Id()  # unwired: element
sortByFunction = List.SortByFunction(list=as_list_groupbykey.VARgroups@L2, func=id)
code_block_6 = CodeBlock { "Nothing To Report"; }
replaceNull = Custom[CW.List.ReplaceNull](VARseq=sortByFunction@L2, VARreplacement=code_block_6)  # Replaces all null values within a given list with a substitute
count = List.Count(list=replaceNull)
code_block_7 = CodeBlock { 1; }
eq_4 = count == code_block_7
flatten_4 = List.Flatten(list=replaceNull)
scopeIf_7 = Custom[CW.ScopeIf+](VARtest=eq_4, VARtrue=flatten_4, VARfalse=replaceNull)
VARReport = Output(scopeIf_7)
VARSwitchJoinOrderForNewelyJoinedElement = Input(VARSwitchJoinOrderForNewelyJoinedElements: var[]..[])
VARStartJoiningNewElements = Input(VARStartJoiningNewElements: var[]..[])
allIndicesOf = List.AllIndicesOf(list=uniqueItems_2, item=scopeIf_6@L2)
flatten_5 = List.Flatten(list=allIndicesOf@L3)
itemAtIndex = Custom[SP.List.ItemAtIndex+](VARlist=sum, VARindex=flatten_5@L2)  # Identical to the built in node but works with negative indices
as_list_sortbykey = Custom[AS.[&] List.SortByKey](VARlist=scopeIf_6, VARkeys=itemAtIndex)  # Sort a list (or lists) according to the order specified by the key list.
scopeIf_8 = Custom[CW.ScopeIf+](VARtest=VARConsiderVolumetricRuleForJoiningMater, VARtrue=as_list_sortbykey.VARsortedlist, VARfalse=filterByBoolMask_8.out)
scopeIf_9 = Custom[CW.ScopeIf+](VARtest=VARStartJoiningNewElements, VARtrue=scopeIf_8, VARfalse=code_block_4)
python_script_4 = Python(IN[0]=scopeIf_9)
# ---------- python_script_4.python (34 lines) ----------
import clr
clr.AddReference('ProtoGeometry')
from Autodesk.DesignScript.Geometry import *

clr.AddReference("RevitAPI")
import Autodesk
from Autodesk.Revit.DB import *

clr.AddReference("RevitServices")
import RevitServices
from RevitServices.Persistence import DocumentManager
from RevitServices.Transactions import TransactionManager
from System.Collections.Generic import *

clr.AddReference("RevitNodes")
import Revit
clr.ImportExtensions(Revit.Elements)

doc = DocumentManager.Instance.CurrentDBDocument
TransactionManager.Instance.EnsureInTransaction(doc)

elements = UnwrapElement(IN[0])
count = 0
result = []
while (count < len(elements)):
	try:
		Autodesk.Revit.DB.JoinGeometryUtils.JoinGeometry(doc, elements[count][0], elements[count][1])
		count = count + 1
		result.append("Success")
	except:
		count = count +1

TransactionManager.Instance.TransactionTaskDone()
OUT = result
# ----------------------------------------
code_block_8 = CodeBlock { "Success"; }
eq_5 = python_script_4 == code_block_8
filterByBoolMask_10 = List.FilterByBoolMask(list=scopeIf_9, mask=eq_5)
code_block_9 = CodeBlock { null; }
scopeIf_10 = Custom[CW.ScopeIf+](VARtest=VARSwitchJoinOrderForNewelyJoinedElement, VARtrue=filterByBoolMask_10.in, VARfalse=code_block_9)
python_script_5 = Python(IN[0]=scopeIf_10)  # same code as python_script_2
end = Revit.Transaction.Transaction.End(input=python_script_5)
getWarnings = Custom[ZK.Document.GetWarnings](VARRefresh=end)  # NOTE: Works only with Revit 2018 and above! Get all warnings from the current document.
code_block_10 = CodeBlock { "Highlighted elements are joined but do not intersect."; }
eq_6 = getWarnings.WarningText == code_block_10
filterByBoolMask_11 = List.FilterByBoolMask(list=getWarnings.FailingElementIds, mask=eq_6)
al_current_document = Custom[AL.Current Document]()  # Retrieves Current Document
al_id_to_element = Custom[AL.Id to Element](VARIds=filterByBoolMask_11.in, VARDoc=al_current_document)  # Selects elements in a model from id input (ElementId, string, integer or GUID)
id_2 = Element.Id(element=al_id_to_element)
string_from_object_4 = FromObject(obj=id_2)
concat = String.Concat(string0=string_from_object_4)
flatten_6 = List.Flatten(list=concat)
code_block_11 = CodeBlock { true; }
getWarnings_2 = Custom[ZK.Document.GetWarnings](VARRefresh=code_block_11)
code_block_12 = CodeBlock { "Highlighted elements are joined but do not intersect."; }
eq_7 = getWarnings_2.WarningText == code_block_12
filterByBoolMask_12 = List.FilterByBoolMask(list=getWarnings_2.FailingElementIds, mask=eq_7)
al_id_to_element_2 = Custom[AL.Id to Element](VARIds=filterByBoolMask_12.in, VARDoc=al_current_document)
id_3 = Element.Id(element=al_id_to_element_2)
string_from_object_5 = FromObject(obj=id_3)
concat_2 = String.Concat(string0=string_from_object_5)
flatten_7 = List.Flatten(list=concat_2)
removeListFromList = Custom[RH.RemoveListFromList](VARListA=flatten_6, VARListB=flatten_7)  # This node essentially "subtracts" the contents of List B from List A to produce a new list with the unique items.
indexOf = List.IndexOf(list=flatten_6, element=removeListFromList)
itemAtIndex_2 = Custom[SP.List.ItemAtIndex+](VARlist=al_id_to_element, VARindex=indexOf)
python_script_6 = Python(IN[0]=itemAtIndex_2)
# ---------- python_script_6.python (34 lines) ----------
import clr
clr.AddReference('ProtoGeometry')
from Autodesk.DesignScript.Geometry import *

clr.AddReference("RevitAPI")
import Autodesk
from Autodesk.Revit.DB import *

clr.AddReference("RevitServices")
import RevitServices
from RevitServices.Persistence import DocumentManager
from RevitServices.Transactions import TransactionManager
from System.Collections.Generic import *

clr.AddReference("RevitNodes")
import Revit
clr.ImportExtensions(Revit.Elements)

doc = DocumentManager.Instance.CurrentDBDocument
TransactionManager.Instance.EnsureInTransaction(doc)

elements = UnwrapElement(IN[0])
count = 0
result = []
while (count < len(elements)):
	try:
		Autodesk.Revit.DB.JoinGeometryUtils.UnjoinGeometry(doc, elements[count][0], elements[count][1])
		count = count + 1
		result.append("Success")
	except:
		count = count +1

TransactionManager.Instance.TransactionTaskDone()
OUT = result
# ----------------------------------------
