# Dynamo custom node Join or Extract By Angle Range.dyf (Dynamo 2.1.0.7500)
# category: Synthesize.Automate.Lines
# Join or Extract By Angle Range

VARFlattentoNearestLevel = Input(VARFlattentoNearestLevel: bool = false)
VARNumberofControlPointsDesired = Input(VARNumberofControlPointsDesired: double = 15)
VARCurves = Input(VARCurves: var[]..[])
flatten = List.Flatten(list=VARCurves)
as_polycurve_bycurves_with = Custom[AS.[&] PolyCurve.ByCurves With Failures](VARcurves=flatten)  # Create polycurves from an unordered list of curves.
VARMaximumAngleDetectionRange = Input(VARMaximumAngleDetectionRange: double = 15)
code_block = CodeBlock { true; }
byAngle = Custom[CurveLoop.Group.ByAngle](VARPolycurves=as_polycurve_bycurves_with.VARpolyCurve, VARSafeAngle=VARMaximumAngleDetectionRange, VARFilterPolyCurvesOnly=code_block)  # CurveLoop.Simplify.ByAngle
flatten_2 = List.Flatten(list=byAngle)
isClosed = Curve.IsClosed(curve=flatten_2)
VARExactSameLineIgnoresNumberofControlPo = Input(VARExactSameLineIgnoresNumberofControlPointsDesiredUsefulforConvertingIntoSmartLines: bool = false)
VARSplitNormalizeFactorExactSameLineMust = Input(VARSplitNormalizeFactorExactSameLineMustbeFasleWorksforClosedLoopsOnly: double = 0.5)
lines_join_and_flatten = Custom[Lines Join and Flatten](VARFlattentoNearestLevel=VARFlattentoNearestLevel, VARNumberofControlPointsDesired=VARNumberofControlPointsDesired, VARCloseCurves=isClosed, VARExactSameLineIgnoresNumberofControlPointsDesiredUsefulforConvertingIntoSmartLines=VARExactSameLineIgnoresNumberofControlPo, VARSplitNormalizeFactorExactSameLineMustbeFasleWorksforClosedLoopsOnly=VARSplitNormalizeFactorExactSameLineMust, VARCurves=flatten_2, lacing=Longest)  # Joins Lines and Flattens them to Nearest Level
VARCurves_2 = Output(lines_join_and_flatten)  # "VARCurves"
