# Dynamo custom node K-Adaptive Component By Coordinate System.dyf (Dynamo 2.1.0.7500)
# category: Synthesize.Automate.Adaptive
# A Better Adaptive Component Placement Method Using Coordinate System

VARCoordinateSystem = Input(VARCoordinateSystem: var[]..[])
VARFamilyType = Input(VARFamilyType: var[]..[])
VARFlip = Input(VARFlip: var[]..[])
python_script = Python(IN[0]=VARCoordinateSystem, IN[1]=VARFamilyType, IN[2]=VARFlip)
# ---------- python_script.python (141 lines) ----------
# Created By Karam Baki : karam@aecedx.com
# Enable Python support and load DesignScript library
# IMPORTANT : ALL DYNAMO DESIGN SCRIPT NODES ARE AS (dg)
import clr
clr.AddReference('ProtoGeometry')
from Autodesk.DesignScript import Geometry as dg

# EXTENSION Enable ToDSType
clr.AddReference('RevitNodes')
import Revit
clr.ImportExtensions(Revit.Elements)

# Enable Revit Elements
from Revit.Elements import *

# EXTENSION Enable Geometry Conversion Methods
clr.ImportExtensions(Revit.GeometryConversion)

# Enable Revit API
clr.AddReference('RevitAPI')
from Autodesk.Revit.DB import *

# Enable DocumentManager and TransactionManager
clr.AddReference('RevitServices')
from RevitServices.Persistence import DocumentManager
from RevitServices.Transactions import TransactionManager

# Enable ICollection List Translate
clr.AddReference("System")
import System.Collections.Generic
from System.Collections.Generic import List

import sys
sys.path.append(r'C:\Program Files (x86)\IronPython 2.7\DLLs')
sys.path.append(r'C:\Program Files (x86)\IronPython 2.7\Lib')
from collections import Iterable

doc = DocumentManager.Instance.CurrentDBDocument
app = doc.Application

pcoor = UnwrapElement(IN[0])
familytype = UnwrapElement(IN[1])
flipped = UnwrapElement(IN[2])

presult = []
result = []
adaptresult = []
Xvec = []
Pointslist = []
tcounttmp = []

if familytype == None:
	sys.exit()
elif AdaptiveComponentInstanceUtils.IsAdaptiveFamilySymbol(familytype) == False:
	sys.exit()

transac = TransactionManager.Instance
transac.ForceCloseTransaction()
fdoc = doc.EditFamily(familytype.Family)
collector = FilteredElementCollector(fdoc).OfCategory(BuiltInCategory.OST_AdaptivePoints).ToElements();
for each in collector:
	try:
		orient = each.get_Parameter(BuiltInParameter.POINT_ADAPTIVE_ORIENTATION_TYPE).AsInteger()
		tcounttmp.append(orient)
	except:
		pass
tcount = len(tcounttmp)
fdoc.Close(False)

for peachlist in pcoor:
	for deteach in peachlist:
		if len(deteach) != tcount:
			sys.exit()

TransactionManager.Instance.EnsureInTransaction(doc)

pcount = 0

for peachlist in pcoor:
	ptmplist = []
	pagaintmp = []
	xtmp = []
	xtmporigin = []
	for peach in peachlist:
		panothertmplist = []
		pandanother = []
		xanother = []
		tmporigin = []
		for psingle in peach:
			panothertmplist.append(SketchPlane.Create(doc, psingle.XYPlane.ToPlane()).GetPlaneReference())
			xanother.append(psingle.XAxis.ToXyz())
			tmporigin.append(psingle.Origin)
		ptmplist.append(panothertmplist)
		xtmp.append(xanother)
		xtmporigin.append(tmporigin)
	presult.append(ptmplist)
	Xvec.append(xtmp)
	Pointslist.append(xtmporigin)

if familytype.IsActive == False:
	familytype.Activate()
	doc.Regenerate()

number = []
for each in Pointslist:
	number.append(len(each))

for each in number:
	start = 0
	anothertmplist = []
	adapttmplist = []
	while start < each:
		tmplist = []
		adapt = AdaptiveComponentInstanceUtils.CreateAdaptiveComponentInstance(doc,familytype)
		adaptivepoints = AdaptiveComponentInstanceUtils.GetInstancePlacementPointElementRefIds(adapt)
		if flipped == True:
			AdaptiveComponentInstanceUtils.SetInstanceFlipped(adapt, True)
		for s in adaptivepoints:
			referencepoints = doc.GetElement(s)
			tmplist.append(referencepoints)
		anothertmplist.append(tmplist)
		adapttmplist.append(adapt)
		start = start + 1
	result.append(anothertmplist)
	adaptresult.append(adapttmplist)

count1 = 0
for eachlists in result:
	count2 = 0
	for singlelist in eachlists:
		count3 = 0
		for apoint in singlelist:
			dynpoints = PointOnPlane.NewPointOnPlane(doc,presult[count1][count2][count3],Pointslist[count1][count2][count3].ToXyz(),XYZ(Xvec[count1][count2][count3].X,Xvec[count1][count2][count3].Y,Xvec[count1][count2][count3].Z))
			apoint.SetPointElementReference(dynpoints)
			count3 = count3 + 1
		count2 = count2 + 1
	count1 = count1 + 1

TransactionManager.Instance.TransactionTaskDone()

OUT = adaptresult
# ----------------------------------------
VARAdaptiveComponent = Output(python_script)
