# Dynamo custom node K-Array By Levels.dyf (Dynamo 2.1.0.7500)
# category: Synthesize.Automate.Array
# K-Array By Levels

VARDisableRotations = Input(VARDisableRotations: var[]..[])
code_block = CodeBlock { null; false; }
VARRandomTypesPlacement = Input(VARRandomTypesPlacement: var[]..[])
VARFamilyTypesList = Input(VARFamilyTypesList: var[]..[])
VARByDistance = Input(VARByDistance: var[]..[] = FalseByNumber = True;)
VARByDistanceStartOffset = Input(VARByDistanceStartOffset: var[]..[])
VARByDistanceDistances = Input(VARByDistanceDistances: var[]..[])
VARByNumberStartRatio = Input(VARByNumberStartRatio: var[]..[])
VARByNumberEndRatio = Input(VARByNumberEndRatio: var[]..[])
VARByDistanceCenterJustification = Input(VARByDistanceCenterJustification: var[]..[])
VARByNumberPositionJustification0to1 = Input(VARByNumberPositionJustification0to1: var[]..[])
VARByNumberNumberofItems = Input(VARByNumberNumberofItems: var[]..[])
VAROffsetClosedLoopsRecommended = Input(VAROffsetClosedLoopsRecommended: var[]..[])
VARReverseArrayDirection = Input(VARReverseArrayDirection: var[]..[])
VARCurves = Input(VARCurves: var[]..[])
VARByDistanceJustifyEachLineSeparately = Input(VARByDistanceJustifyEachLineSeparately: var[]..[])
VARByDistanceForceStart = Input(VARByDistanceForceStart: var[]..[])
VARByDistanceForceEnd = Input(VARByDistanceForceEnd: var[]..[])
k_array_points_only = Custom[K-Array Points Only](VARByDistance=VARByDistance, VARByDistanceStartOffset=VARByDistanceStartOffset, VARByDistanceDistances=VARByDistanceDistances, VARByNumberStartRatio=VARByNumberStartRatio, VARByNumberEndRatio=VARByNumberEndRatio, VARByDistanceCenterJustification=VARByDistanceCenterJustification, VARByNumberPositionJustification0to1=VARByNumberPositionJustification0to1, VARByNumberNumberofItems=VARByNumberNumberofItems, VAROffsetClosedLoopsRecommended=VAROffsetClosedLoopsRecommended, VARReverseArrayDirection=VARReverseArrayDirection, VARCurves=VARCurves, VARByDistanceJustifyEachLineSeparately=VARByDistanceJustifyEachLineSeparately, VARByDistanceForceStart=VARByDistanceForceStart, VARByDistanceForceEnd=VARByDistanceForceEnd)  # K-Array By Levels
count = List.Count(list=k_array_points_only.VARPoints@L2)
cycle = List.Cycle(list=VARFamilyTypesList, amount=count)
count_2 = List.Count(list=cycle@L2)
count_3 = List.Count(list=VARFamilyTypesList)
div = count_2 / count_3
takeItems = List.TakeItems(list=cycle, amount=div, lacing=Longest)
shuffle = List.Shuffle(list=takeItems@L2)
scopeIf = Custom[CW.ScopeIf+](VARtest=VARRandomTypesPlacement, VARtrue=shuffle, VARfalse=takeItems)  # A (hopefully) more robust implementation of ScopeIf. Tests a single boolean and returns a value accordingly.
flatten = List.Flatten(list=scopeIf)
flatten_2 = List.Flatten(list=k_array_points_only.VARPoints)
element_types = ElementTypes("Level")
all_elements_of_type = ElementsOfType(element_type=element_types)
code_block_2 = CodeBlock { "Elevation"; }
getParameterValueByName = Element.GetParameterValueByName(parameterName=code_block_2)  # unwired: element
sortByFunction = List.SortByFunction(list=all_elements_of_type, func=getParameterValueByName)
count_4 = List.Count(list=flatten_2)
cycle_2 = List.Cycle(list=sortByFunction, amount=count_4)
count_5 = List.Count(list=sortByFunction)
chop = List.Chop(list=cycle_2, lengths=count_5)
code_block_3 = CodeBlock { 1; }
chop_2 = List.Chop(list=sortByFunction, lengths=code_block_3)
plane = Custom[CW.Level.Plane](VARlevel=chop_2)  # Retrieves the plane of a given level
boundingBox = Geometry.BoundingBox(geometry=plane)
flatten_3 = List.Flatten(list=boundingBox)
minPoint = BoundingBox.MinPoint(boundingBox=flatten_3)
maxPoint = BoundingBox.MaxPoint(boundingBox=flatten_3)
X = Point.X(point=maxPoint)
VARFixFactorDependsofProjectUnits1Formet = Input(VARFixFactorDependsofProjectUnits1Formetersforexampleand100forCentimeters: var[]..[])
mul = X * VARFixFactorDependsofProjectUnits1Formet
Y = Point.Y(point=maxPoint)
mul_2 = Y * VARFixFactorDependsofProjectUnits1Formet
projectElevation = Level.ProjectElevation(level=sortByFunction)
code_block_4 = CodeBlock { -1; }
shiftIndices = List.ShiftIndices(list=projectElevation, amount=code_block_4)
getKeys = GetKeys(list=shiftIndices)
lastItem = List.LastItem(list=getKeys)
maximumItem = List.MaximumItem(list=shiftIndices)
code_block_5 = CodeBlock { 2; }
mul_3 = maximumItem * code_block_5
replaceItemAtIndex = List.ReplaceItemAtIndex(list=shiftIndices, index=lastItem, item=mul_3)
dm_fix_point_bycoordinates_range = Custom[DM.Fix Point.ByCoordinates Range](VARx=mul, VARy=mul_2, VARz=replaceItemAtIndex)  # Dummy Node to fix the modelling range warning
byCorners = BoundingBox.ByCorners(min=minPoint, max=dm_fix_point_bycoordinates_range)
contains = BoundingBox.Contains(boundingBox=byCorners, point=flatten_2@L1)
filterByBoolMask = List.FilterByBoolMask(list=chop, mask=contains)
code_block_6 = CodeBlock { null; }
replaceEmptyLists = Custom[CW.List.ReplaceEmptyLists](VARseq=filterByBoolMask.in, VARReplacement=code_block_6)  # Replaces all empty lists within a given list with a substitute
lastItem_2 = List.LastItem(list=replaceEmptyLists@L2)
Z = Point.Z(point=flatten_2)
bk_find_nearest_revit_level_for = Custom[BK.Find Nearest Revit Level for a Given Z value](VARzvalue=Z@L1)
flatten_4 = List.Flatten(list=bk_find_nearest_revit_level_for)
isNull = Object.IsNull()  # unwired: obj
replaceByCondition = Replace(item=lastItem_2, replaceWith=flatten_4, condition=isNull)
flatten_5 = List.Flatten(list=replaceByCondition)
byPointAndLevel = FamilyInstance.ByPointAndLevel(familyType=flatten, point=flatten_2, level=flatten_5)
flatten_6 = List.Flatten(list=byPointAndLevel)
scopeIf_2 = Custom[CW.ScopeIf+](VARtest=VARDisableRotations, VARtrue=code_block.out0, VARfalse=flatten_6)
clean = List.Clean(list=scopeIf_2, preserveIndices=code_block.out1)
VARRandomizeRotations = Input(VARRandomizeRotations: var[]..[])
code_block_7 = CodeBlock { false; }
clean_2 = List.Clean(list=k_array_points_only.VARPoints, preserveIndices=code_block_7)
parameterAtPoint = Curve.ParameterAtPoint(curve=k_array_points_only.VARExtendedPolycurves, point=clean_2, lacing=Longest)
tangentAtParameter = Curve.TangentAtParameter(curve=k_array_points_only.VARExtendedPolycurves, param=parameterAtPoint, lacing=Longest)
XAxis = Vector.XAxis()
ZAxis = Vector.ZAxis()
angleAboutAxis = Vector.AngleAboutAxis(vector=tangentAtParameter, otherVector=XAxis, rotationAxis=ZAxis)
VARRotationAngletoAddCanbe0 = Input(VARRotationAngletoAddCanbe0: var[]..[])
add = angleAboutAxis + VARRotationAngletoAddCanbe0
flatten_7 = List.Flatten(list=add)
VARMinimumRandomRotationAngleUsefulWhenR = Input(VARMinimumRandomRotationAngleUsefulWhenRandomizeRotationsisActivated: var[]..[])
count_6 = List.Count(list=angleAboutAxis@L2)
cycle_3 = List.Cycle(list=VARMinimumRandomRotationAngleUsefulWhenR, amount=count_6)
VARMaximumRandomRotationAngleUsefulWhenR = Input(VARMaximumRandomRotationAngleUsefulWhenRandomizeRotationsisActivated: var[]..[])
count_7 = List.Count(list=angleAboutAxis@L2)
cycle_4 = List.Cycle(list=VARMaximumRandomRotationAngleUsefulWhenR, amount=count_7)
random = Math.Random(value1=cycle_3, value2=cycle_4)
flatten_8 = List.Flatten(list=random)
add_2 = flatten_7 + flatten_8
scopeIf_3 = Custom[CW.ScopeIf+](VARtest=VARRandomizeRotations, VARtrue=add_2, VARfalse=flatten_7)
scopeIf_4 = Custom[CW.ScopeIf+](VARtest=VARDisableRotations, VARtrue=code_block.out0, VARfalse=scopeIf_3)
clean_3 = List.Clean(list=scopeIf_4, preserveIndices=code_block.out1)
setRotation = FamilyInstance.SetRotation(familyInstance=clean, degree=clean_3)
getLocation = Element.GetLocation(element=setRotation)
string_from_object = FromObject(obj=getLocation)
flatten_9 = List.Flatten(list=clean_2)
string_from_object_2 = FromObject(obj=flatten_9)
eq = string_from_object == string_from_object_2
filterByBoolMask_2 = List.FilterByBoolMask(list=setRotation, mask=eq)
filterByBoolMask_3 = List.FilterByBoolMask(list=flatten_9, mask=eq)
setLocation = Element.SetLocation(element=filterByBoolMask_2.out, geometry=filterByBoolMask_3.out)
code_block_8 = CodeBlock { 1; }
code_block_9 = CodeBlock { 0.01; }
roundToPrecision = Custom[CW.Math.RoundToPrecision](VARdbl=k_array_points_only.VARSpaces, VARprecision=code_block_9)  # Rounds a number to a specified precision
VARNumberofElementstoRemoveafterArrayNeg = Input(VARNumberofElementstoRemoveafterArrayNegativetoRemovefromtheEnd: var[]..[])
VARRemovefromBothStartandEnd = Input(VARRemovefromBothStartandEnd: var[]..[])
code_block_10 = CodeBlock { -1; 0; false; }
scopeIf_5 = Custom[CW.ScopeIf+](VARtest=VARRemovefromBothStartandEnd, VARtrue=code_block_10.out0, VARfalse=code_block_10.out1)
mul_4 = VARNumberofElementstoRemoveafterArrayNeg * scopeIf_5
dropItems = List.DropItems(list=roundToPrecision@L2, amount=mul_4)
dropItems_2 = List.DropItems(list=roundToPrecision@L2, amount=VARNumberofElementstoRemoveafterArrayNeg)
equals = Custom[LF.IndexOf.Equals](VARlistA=dropItems_2@L2, VARlistB=dropItems@L2)  # Returns the indices of items in list B that are equal to items in list A.
getItemAtIndex = List.GetItemAtIndex(list=dropItems@L2, index=equals@L2)
VARSpacesReport = Output(getItemAtIndex)
count_8 = List.Count(list=scopeIf@L2)
abs = Math.Abs(number=VARNumberofElementstoRemoveafterArrayNeg)
sub = count_8 - abs
abs_2 = Math.Abs(number=mul_4)
sub_2 = sub - abs_2
scopeIf_6 = Custom[CW.ScopeIf+](VARtest=VARRemovefromBothStartandEnd, VARtrue=sub_2, VARfalse=sub)
VARNumberofFamiliesPlacedPerPath = Output(scopeIf_6)
count_9 = List.Count(list=flatten_6)
mul_5 = abs * k_array_points_only.VARNumberofPolycurves
sub_3 = count_9 - mul_5
mul_6 = abs_2 * k_array_points_only.VARNumberofPolycurves
sub_4 = sub_3 - mul_6
VARTotalFamiliesPlaced = Output(sub_4)
VARElements = Output(flatten_6)
join = List.Join()  # unwired: list0, list1
sublistLengths = Custom[CW.List.SublistLengths](VARseq=clean_2)  # Gets the lengths of all sublists in a given list of lists.
chopByLengths = Custom[CW.List.ChopByLengths](VARlengths=sublistLengths, VARlist=setRotation)  # Turns a list into a list of lists with sublists of varying lengths.
takeItems_2 = List.TakeItems(list=chopByLengths@L2, amount=VARNumberofElementstoRemoveafterArrayNeg)
takeItems_3 = List.TakeItems(list=chopByLengths@L2, amount=mul_4)
combine = List.Combine(comb=join, list1=takeItems_2, list2=takeItems_3)
clean_4 = List.Clean(list=combine, preserveIndices=code_block_10.out2)
flatten_10 = List.Flatten(list=clean_4)
passthrough = Custom[CW.Passthrough](VARpassThrough=flatten_10, VARwaitFor=getLocation)  # Forces a sequential order of execution. The node wired into the output of the Passthrough node will be executed *after* the node wired into the waitFor input (e.g. important for some Revit operations). The value of the passThrough input will be passed on to the node wired into the output port of the Passthrough node.
VARElementstoErase = Output(passthrough)
