# Dynamo custom node K-Array By Workplanes Organic.dyf (Dynamo 2.1.0.7500)
# category: Synthesize.Automate.Array
# K-Array By Workplanes on Organic Faces

VARRandomTypesPlacement = Input(VARRandomTypesPlacement: var[]..[])
VARFamilyTypesList = Input(VARFamilyTypesList: var[]..[])
VARByDistance = Input(VARByDistance: var[]..[] = FalseByNumber = True;)
VARByDistanceStartOffset = Input(VARByDistanceStartOffset: var[]..[])
VARByDistanceDistances = Input(VARByDistanceDistances: var[]..[])
VARByNumberStartRatio = Input(VARByNumberStartRatio: var[]..[])
VARByNumberEndRatio = Input(VARByNumberEndRatio: var[]..[])
VARByDistanceCenterJustification = Input(VARByDistanceCenterJustification: var[]..[])
VARByNumberPositionJustification0to1 = Input(VARByNumberPositionJustification0to1: var[]..[])
VARByNumberNumberofItems = Input(VARByNumberNumberofItems: var[]..[])
code_block = CodeBlock { 0; }
VARReverseArrayDirection = Input(VARReverseArrayDirection: var[]..[])
VARCurves = Input(VARCurves: var[]..[])
flatten = List.Flatten(list=VARCurves)
VARPickPoints = Input(VARPickPoints: var[]..[])
closestPointTo = Geometry.ClosestPointTo(geometry=flatten, other=VARPickPoints, lacing=Longest)
byTwoPoints = Vector.ByTwoPoints(start=closestPointTo, end=VARPickPoints, lacing=Longest)
VAROffset = Input(VAROffset: var[]..[])
translate = Geometry.Translate(geometry=flatten, direction=byTwoPoints, distance=VAROffset)
VARSurfaces = Input(VARSurfaces: var[]..[])
pullOntoSurface = Curve.PullOntoSurface(curve=translate, surface=VARSurfaces, lacing=Longest)
isNull = Object.IsNull()  # unwired: obj
replaceByCondition = Replace(item=pullOntoSurface, replaceWith=translate, condition=isNull)
flatten_2 = List.Flatten(list=replaceByCondition)
intersect = Geometry.Intersect(geometry=flatten_2@L1, other=flatten_2)
code_block_2 = CodeBlock { false; }
clean = List.Clean(list=intersect, preserveIndices=code_block_2)
flatten_3 = List.Flatten(list=clean@L3)
code_block_3 = CodeBlock { "Point"; }
byClassName = Custom[SP.Filter.ByClassName](VARobject=flatten_3, VARclassName=code_block_3)  # Filters a list of objects by the object's class name. Note that Dynamo elements belong to different classes than their Revit counterparts. Use the Object.Class node to check an object's class.
splitByPoints = Curve.SplitByPoints(curve=replaceByCondition, points=byClassName.VARin)
flatten_4 = List.Flatten(list=splitByPoints@L2)
closestPointTo_2 = Geometry.ClosestPointTo(geometry=flatten_4, other=VARPickPoints, lacing=Longest)
byStartPointEndPoint = Line.ByStartPointEndPoint(startPoint=closestPointTo_2, endPoint=VARPickPoints, lacing=Longest)
length = Curve.Length(curve=byStartPointEndPoint)
minimumItem = List.MinimumItem(list=length)
eq = length == minimumItem
filterByBoolMask = List.FilterByBoolMask(list=flatten_4, mask=eq)
flatten_5 = List.Flatten(list=filterByBoolMask.in)
as_polycurve_bycurves = Custom[AS.[&] PolyCurve.ByCurves](VARcurves=flatten_5)  # Create polycurves from an unordered list of curves.
code_block_4 = CodeBlock { false; }
clean_2 = List.Clean(list=as_polycurve_bycurves.VARpolyCurve, preserveIndices=code_block_4)
flatten_6 = List.Flatten(list=clean_2)
VARByDistanceJustifyEachLineSeparately = Input(VARByDistanceJustifyEachLineSeparately: var[]..[])
VARByDistanceForceStart = Input(VARByDistanceForceStart: var[]..[])
VARByDistanceForceEnd = Input(VARByDistanceForceEnd: var[]..[])
k_array_points_only = Custom[K-Array Points Only](VARByDistance=VARByDistance, VARByDistanceStartOffset=VARByDistanceStartOffset, VARByDistanceDistances=VARByDistanceDistances, VARByNumberStartRatio=VARByNumberStartRatio, VARByNumberEndRatio=VARByNumberEndRatio, VARByDistanceCenterJustification=VARByDistanceCenterJustification, VARByNumberPositionJustification0to1=VARByNumberPositionJustification0to1, VARByNumberNumberofItems=VARByNumberNumberofItems, VAROffsetClosedLoopsRecommended=code_block, VARReverseArrayDirection=VARReverseArrayDirection, VARCurves=flatten_6, VARByDistanceJustifyEachLineSeparately=VARByDistanceJustifyEachLineSeparately, VARByDistanceForceStart=VARByDistanceForceStart, VARByDistanceForceEnd=VARByDistanceForceEnd)  # K-Array By Levels
count = List.Count(list=k_array_points_only.VARPoints@L2)
cycle = List.Cycle(list=VARFamilyTypesList, amount=count)
count_2 = List.Count(list=cycle@L2)
count_3 = List.Count(list=VARFamilyTypesList)
div = count_2 / count_3
takeItems = List.TakeItems(list=cycle, amount=div, lacing=Longest)
shuffle = List.Shuffle(list=takeItems@L2)
scopeIf = Custom[CW.ScopeIf+](VARtest=VARRandomTypesPlacement, VARtrue=shuffle, VARfalse=takeItems)  # A (hopefully) more robust implementation of ScopeIf. Tests a single boolean and returns a value accordingly.
flatten_7 = List.Flatten(list=scopeIf)
cycle_2 = List.Cycle(list=VARSurfaces, amount=count)
flatten_8 = List.Flatten(list=cycle_2)
flatten_9 = List.Flatten(list=k_array_points_only.VARPoints)
code_block_5 = CodeBlock { false; }
clean_3 = List.Clean(list=flatten_9, preserveIndices=code_block_5)
flatten_10 = List.Flatten(list=clean_3)
code_block_6 = CodeBlock { false; }
clean_4 = List.Clean(list=k_array_points_only.VARPoints, preserveIndices=code_block_6)
parameterAtPoint = Curve.ParameterAtPoint(curve=k_array_points_only.VARExtendedPolycurves, point=clean_4, lacing=Longest)
flatten_11 = List.Flatten(list=parameterAtPoint)
tangentAtParameter = Curve.TangentAtParameter(curve=k_array_points_only.VARExtendedPolycurves, param=flatten_11, lacing=Longest)
flatten_12 = List.Flatten(list=tangentAtParameter)
UVParameterAtPoint = Surface.UVParameterAtPoint(surface=VARSurfaces, point=flatten_10, lacing=Longest)
U = UV.U(uV=UVParameterAtPoint)
V = UV.V(uV=UVParameterAtPoint)
coordinateSystemAtParameter = Surface.CoordinateSystemAtParameter(surface=VARSurfaces, u=U, v=V, lacing=Longest)
ZAxis = CoordinateSystem.ZAxis(coordinateSystem=coordinateSystemAtParameter)
flatten_13 = List.Flatten(list=ZAxis)
VARRandomizeRotations = Input(VARRandomizeRotations: var[]..[])
VARMinimumRandomRotationAngleUsefulWhenR = Input(VARMinimumRandomRotationAngleUsefulWhenRandomizeRotationsisActivated: var[]..[])
count_4 = List.Count(list=flatten_12@L2)
cycle_3 = List.Cycle(list=VARMinimumRandomRotationAngleUsefulWhenR, amount=count_4)
VARMaximumRandomRotationAngleUsefulWhenR = Input(VARMaximumRandomRotationAngleUsefulWhenRandomizeRotationsisActivated: var[]..[])
count_5 = List.Count(list=flatten_12@L2)
cycle_4 = List.Cycle(list=VARMaximumRandomRotationAngleUsefulWhenR, amount=count_5)
random = Math.Random(value1=cycle_3, value2=cycle_4)
flatten_14 = List.Flatten(list=random)
VARRotationAngletoAddCanbe0 = Input(VARRotationAngletoAddCanbe0: var[]..[])
scopeIf_2 = Custom[CW.ScopeIf+](VARtest=VARRandomizeRotations, VARtrue=flatten_14, VARfalse=VARRotationAngletoAddCanbe0)
rotate = Vector.Rotate(vector=flatten_12, axis=flatten_13, degrees=scopeIf_2)
flatten_15 = List.Flatten(list=rotate)
byFace = FamilyInstance.ByFace(familyType=flatten_7, face=flatten_8, location=flatten_10, referenceDirection=flatten_15)
flatten_16 = List.Flatten(list=byFace)
VARElements = Output(flatten_16)
code_block_7 = CodeBlock { 0.01; }
roundToPrecision = Custom[CW.Math.RoundToPrecision](VARdbl=k_array_points_only.VARSpaces, VARprecision=code_block_7)  # Rounds a number to a specified precision
VARNumberofElementstoRemoveafterArrayNeg = Input(VARNumberofElementstoRemoveafterArrayNegativetoRemovefromtheEnd: var[]..[])
VARRemovefromBothStartandEnd = Input(VARRemovefromBothStartandEnd: var[]..[])
code_block_8 = CodeBlock { -1; 0; false; }
scopeIf_3 = Custom[CW.ScopeIf+](VARtest=VARRemovefromBothStartandEnd, VARtrue=code_block_8.out0, VARfalse=code_block_8.out1)
mul = VARNumberofElementstoRemoveafterArrayNeg * scopeIf_3
dropItems = List.DropItems(list=roundToPrecision@L2, amount=mul)
dropItems_2 = List.DropItems(list=roundToPrecision@L2, amount=VARNumberofElementstoRemoveafterArrayNeg)
equals = Custom[LF.IndexOf.Equals](VARlistA=dropItems_2@L2, VARlistB=dropItems@L2)  # Returns the indices of items in list B that are equal to items in list A.
getItemAtIndex = List.GetItemAtIndex(list=dropItems@L2, index=equals@L2)
VARSpacesReport = Output(getItemAtIndex)
count_6 = List.Count(list=scopeIf@L2)
abs = Math.Abs(number=VARNumberofElementstoRemoveafterArrayNeg)
sub = count_6 - abs
abs_2 = Math.Abs(number=mul)
sub_2 = sub - abs_2
scopeIf_4 = Custom[CW.ScopeIf+](VARtest=VARRemovefromBothStartandEnd, VARtrue=sub_2, VARfalse=sub)
VARNumberofFamiliesPlacedPerPath = Output(scopeIf_4)
count_7 = List.Count(list=flatten_16)
mul_2 = abs * k_array_points_only.VARNumberofPolycurves
sub_3 = count_7 - mul_2
mul_3 = abs_2 * k_array_points_only.VARNumberofPolycurves
sub_4 = sub_3 - mul_3
VARTotalFamiliesPlaced = Output(sub_4)
join = List.Join()  # unwired: list0, list1
sublistLengths = Custom[CW.List.SublistLengths](VARseq=clean_4)  # Gets the lengths of all sublists in a given list of lists.
code_block_9 = CodeBlock { false; }
clean_5 = List.Clean(list=flatten_16, preserveIndices=code_block_9)
chopByLengths = Custom[CW.List.ChopByLengths](VARlengths=sublistLengths, VARlist=clean_5)  # Turns a list into a list of lists with sublists of varying lengths.
takeItems_2 = List.TakeItems(list=chopByLengths@L2, amount=VARNumberofElementstoRemoveafterArrayNeg)
takeItems_3 = List.TakeItems(list=chopByLengths@L2, amount=mul)
combine = List.Combine(comb=join, list1=takeItems_2, list2=takeItems_3)
clean_6 = List.Clean(list=combine, preserveIndices=code_block_8.out2)
flatten_17 = List.Flatten(list=clean_6)
VARElementstoErase = Output(flatten_17)
