# Dynamo custom node K-Array By Workplanes.dyf (Dynamo 2.1.0.7500)
# category: Synthesize.Automate.Array
# K-Array By Workplanes

VARByDistance = Input(VARByDistance: var[]..[] = FalseByNumber = True;)
VARByDistanceStartOffset = Input(VARByDistanceStartOffset: var[]..[])
VARByDistanceDistances = Input(VARByDistanceDistances: var[]..[])
VARByNumberStartRatio = Input(VARByNumberStartRatio: var[]..[])
VARByNumberEndRatio = Input(VARByNumberEndRatio: var[]..[])
VARByDistanceCenterJustification = Input(VARByDistanceCenterJustification: var[]..[])
VARByNumberPositionJustification0to1 = Input(VARByNumberPositionJustification0to1: var[]..[])
VARByNumberNumberofItems = Input(VARByNumberNumberofItems: var[]..[])
VAROffsetClosedLoopsRecommended = Input(VAROffsetClosedLoopsRecommended: var[]..[])
VARReverseArrayDirection = Input(VARReverseArrayDirection: var[]..[])
VARCurves = Input(VARCurves: var[]..[])
VARByDistanceJustifyEachLineSeparately = Input(VARByDistanceJustifyEachLineSeparately: var[]..[])
VARByDistanceForceStart = Input(VARByDistanceForceStart: var[]..[])
VARByDistanceForceEnd = Input(VARByDistanceForceEnd: var[]..[])
k_array_points_only = Custom[K-Array Points Only](VARByDistance=VARByDistance, VARByDistanceStartOffset=VARByDistanceStartOffset, VARByDistanceDistances=VARByDistanceDistances, VARByNumberStartRatio=VARByNumberStartRatio, VARByNumberEndRatio=VARByNumberEndRatio, VARByDistanceCenterJustification=VARByDistanceCenterJustification, VARByNumberPositionJustification0to1=VARByNumberPositionJustification0to1, VARByNumberNumberofItems=VARByNumberNumberofItems, VAROffsetClosedLoopsRecommended=VAROffsetClosedLoopsRecommended, VARReverseArrayDirection=VARReverseArrayDirection, VARCurves=VARCurves, VARByDistanceJustifyEachLineSeparately=VARByDistanceJustifyEachLineSeparately, VARByDistanceForceStart=VARByDistanceForceStart, VARByDistanceForceEnd=VARByDistanceForceEnd)  # K-Array By Levels
code_block = CodeBlock { 0.01; }
roundToPrecision = Custom[CW.Math.RoundToPrecision](VARdbl=k_array_points_only.VARSpaces, VARprecision=code_block)  # Rounds a number to a specified precision
VARNumberofElementstoRemoveafterArrayNeg = Input(VARNumberofElementstoRemoveafterArrayNegativetoRemovefromtheEnd: var[]..[])
VARRemovefromBothStartandEnd = Input(VARRemovefromBothStartandEnd: var[]..[])
code_block_2 = CodeBlock { -1; 0; false; }
scopeIf = Custom[CW.ScopeIf+](VARtest=VARRemovefromBothStartandEnd, VARtrue=code_block_2.out0, VARfalse=code_block_2.out1)  # A (hopefully) more robust implementation of ScopeIf. Tests a single boolean and returns a value accordingly.
mul = VARNumberofElementstoRemoveafterArrayNeg * scopeIf
dropItems = List.DropItems(list=roundToPrecision@L2, amount=mul)
dropItems_2 = List.DropItems(list=roundToPrecision@L2, amount=VARNumberofElementstoRemoveafterArrayNeg)
equals = Custom[LF.IndexOf.Equals](VARlistA=dropItems_2@L2, VARlistB=dropItems@L2)  # Returns the indices of items in list B that are equal to items in list A.
getItemAtIndex = List.GetItemAtIndex(list=dropItems@L2, index=equals@L2)
VARSpaceReport = Output(getItemAtIndex)
VARRandomTypesPlacement = Input(VARRandomTypesPlacement: var[]..[])
VARFamilyTypesList = Input(VARFamilyTypesList: var[]..[])
count = List.Count(list=k_array_points_only.VARPoints@L2)
cycle = List.Cycle(list=VARFamilyTypesList, amount=count)
count_2 = List.Count(list=cycle@L2)
count_3 = List.Count(list=VARFamilyTypesList)
div = count_2 / count_3
takeItems = List.TakeItems(list=cycle, amount=div, lacing=Longest)
shuffle = List.Shuffle(list=takeItems@L2)
scopeIf_2 = Custom[CW.ScopeIf+](VARtest=VARRandomTypesPlacement, VARtrue=shuffle, VARfalse=takeItems)
count_4 = List.Count(list=scopeIf_2@L2)
abs = Math.Abs(number=VARNumberofElementstoRemoveafterArrayNeg)
sub = count_4 - abs
abs_2 = Math.Abs(number=mul)
sub_2 = sub - abs_2
scopeIf_3 = Custom[CW.ScopeIf+](VARtest=VARRemovefromBothStartandEnd, VARtrue=sub_2, VARfalse=sub)
VARNumberofFamiliesPlacedPerPath = Output(scopeIf_3)
flatten = List.Flatten(list=scopeIf_2)
VARSelectFaces = Input(VARSelectFaces: var[]..[])
flatten_2 = List.Flatten(list=VARSelectFaces)
flatten_3 = List.Flatten(list=k_array_points_only.VARPoints)
code_block_3 = CodeBlock { false; }
clean = List.Clean(list=flatten_3, preserveIndices=code_block_3)
flatten_4 = List.Flatten(list=clean)
count_5 = List.Count(list=flatten_4)
ofRepeatedItem = List.OfRepeatedItem(item=flatten_2, amount=count_5)
doesIntersect = Geometry.DoesIntersect(geometry=ofRepeatedItem, other=flatten_4)
filterByBoolMask = List.FilterByBoolMask(list=ofRepeatedItem, mask=doesIntersect)
lastItem = List.LastItem(list=filterByBoolMask.in@L2)
code_block_4 = CodeBlock { false; }
clean_2 = List.Clean(list=k_array_points_only.VARPoints, preserveIndices=code_block_4)
parameterAtPoint = Curve.ParameterAtPoint(curve=k_array_points_only.VARExtendedPolycurves, point=clean_2, lacing=Longest)
tangentAtParameter = Curve.TangentAtParameter(curve=k_array_points_only.VARExtendedPolycurves, param=parameterAtPoint, lacing=Longest)
flatten_5 = List.Flatten(list=tangentAtParameter)
coordinateSystemAtParameter = Surface.CoordinateSystemAtParameter(surface=lastItem, lacing=CrossProduct)
ZAxis = CoordinateSystem.ZAxis(coordinateSystem=coordinateSystemAtParameter)
VARRandomizeRotations = Input(VARRandomizeRotations: var[]..[])
VARMinimumRandomRotationAngleUsefulWhenR = Input(VARMinimumRandomRotationAngleUsefulWhenRandomizeRotationsisActivated: var[]..[])
count_6 = List.Count(list=flatten_5@L2)
cycle_2 = List.Cycle(list=VARMinimumRandomRotationAngleUsefulWhenR, amount=count_6)
VARMaximumRandomRotationAngleUsefulWhenR = Input(VARMaximumRandomRotationAngleUsefulWhenRandomizeRotationsisActivated: var[]..[])
count_7 = List.Count(list=flatten_5@L2)
cycle_3 = List.Cycle(list=VARMaximumRandomRotationAngleUsefulWhenR, amount=count_7)
random = Math.Random(value1=cycle_2, value2=cycle_3)
flatten_6 = List.Flatten(list=random)
VARRotationAngletoAddCanbe0 = Input(VARRotationAngletoAddCanbe0: var[]..[])
scopeIf_4 = Custom[CW.ScopeIf+](VARtest=VARRandomizeRotations, VARtrue=flatten_6, VARfalse=VARRotationAngletoAddCanbe0)
rotate = Vector.Rotate(vector=flatten_5, axis=ZAxis, degrees=scopeIf_4)
byFace = FamilyInstance.ByFace(familyType=flatten, face=lastItem, location=flatten_4, referenceDirection=rotate)
flatten_7 = List.Flatten(list=byFace)
count_8 = List.Count(list=flatten_7)
mul_2 = abs * k_array_points_only.VARNumberofPolycurves
sub_3 = count_8 - mul_2
mul_3 = abs_2 * k_array_points_only.VARNumberofPolycurves
sub_4 = sub_3 - mul_3
VARTotalFamiliesPlaced = Output(sub_4)
VARElements = Output(flatten_7)
join = List.Join()  # unwired: list0, list1
sublistLengths = Custom[CW.List.SublistLengths](VARseq=clean_2)  # Gets the lengths of all sublists in a given list of lists.
code_block_5 = CodeBlock { false; }
clean_3 = List.Clean(list=flatten_7, preserveIndices=code_block_5)
chopByLengths = Custom[CW.List.ChopByLengths](VARlengths=sublistLengths, VARlist=clean_3)  # Turns a list into a list of lists with sublists of varying lengths.
takeItems_2 = List.TakeItems(list=chopByLengths@L2, amount=VARNumberofElementstoRemoveafterArrayNeg)
takeItems_3 = List.TakeItems(list=chopByLengths@L2, amount=mul)
combine = List.Combine(comb=join, list1=takeItems_2, list2=takeItems_3)
clean_4 = List.Clean(list=combine, preserveIndices=code_block_2.out2)
flatten_8 = List.Flatten(list=clean_4)
VARElementstoErase = Output(flatten_8)
