# Dynamo custom node K-Array For Revit Links.dyf (Dynamo 2.1.0.7500)
# category: Synthesize.Automate.Array
# K-Array By Levels

VARRevitLinkType = Input(VARRevitLinkType: var[]..[])
VARByDistance = Input(VARByDistance: var[]..[] = FalseByNumber = True;)
VARByDistanceStartOffset = Input(VARByDistanceStartOffset: var[]..[])
VARByDistanceDistances = Input(VARByDistanceDistances: var[]..[])
VARByNumberStartRatio = Input(VARByNumberStartRatio: var[]..[])
VARByNumberEndRatio = Input(VARByNumberEndRatio: var[]..[])
VARByDistanceCenterJustification = Input(VARByDistanceCenterJustification: var[]..[])
VARByNumberPositionJustification0to1 = Input(VARByNumberPositionJustification0to1: var[]..[])
VARByNumberNumberofItems = Input(VARByNumberNumberofItems: var[]..[])
VAROffsetClosedLoopsRecommended = Input(VAROffsetClosedLoopsRecommended: var[]..[])
VARReverseArrayDirection = Input(VARReverseArrayDirection: var[]..[])
VARCurves = Input(VARCurves: var[]..[])
VARByDistanceJustifyEachLineSeparately = Input(VARByDistanceJustifyEachLineSeparately: var[]..[])
VARByDistanceForceStart = Input(VARByDistanceForceStart: var[]..[])
VARByDistanceForceEnd = Input(VARByDistanceForceEnd: var[]..[])
k_array_points_only = Custom[K-Array Points Only](VARByDistance=VARByDistance, VARByDistanceStartOffset=VARByDistanceStartOffset, VARByDistanceDistances=VARByDistanceDistances, VARByNumberStartRatio=VARByNumberStartRatio, VARByNumberEndRatio=VARByNumberEndRatio, VARByDistanceCenterJustification=VARByDistanceCenterJustification, VARByNumberPositionJustification0to1=VARByNumberPositionJustification0to1, VARByNumberNumberofItems=VARByNumberNumberofItems, VAROffsetClosedLoopsRecommended=VAROffsetClosedLoopsRecommended, VARReverseArrayDirection=VARReverseArrayDirection, VARCurves=VARCurves, VARByDistanceJustifyEachLineSeparately=VARByDistanceJustifyEachLineSeparately, VARByDistanceForceStart=VARByDistanceForceStart, VARByDistanceForceEnd=VARByDistanceForceEnd)  # K-Array By Levels
flatten = List.Flatten(list=k_array_points_only.VARPoints)
VARDisableRotations = Input(VARDisableRotations: var[]..[])
code_block = CodeBlock { null; false; }
VARRandomizeRotations = Input(VARRandomizeRotations: var[]..[])
code_block_2 = CodeBlock { false; }
clean = List.Clean(list=k_array_points_only.VARPoints, preserveIndices=code_block_2)
parameterAtPoint = Curve.ParameterAtPoint(curve=k_array_points_only.VARExtendedPolycurves, point=clean, lacing=Longest)
tangentAtParameter = Curve.TangentAtParameter(curve=k_array_points_only.VARExtendedPolycurves, param=parameterAtPoint, lacing=Longest)
XAxis = Vector.XAxis()
ZAxis = Vector.ZAxis()
angleAboutAxis = Vector.AngleAboutAxis(vector=tangentAtParameter, otherVector=XAxis, rotationAxis=ZAxis)
VARRotationAngletoAddCanbe0 = Input(VARRotationAngletoAddCanbe0: var[]..[])
add = angleAboutAxis + VARRotationAngletoAddCanbe0
flatten_2 = List.Flatten(list=add)
VARMinimumRandomRotationAngleUsefulWhenR = Input(VARMinimumRandomRotationAngleUsefulWhenRandomizeRotationsisActivated: var[]..[])
count = List.Count(list=angleAboutAxis@L2)
cycle = List.Cycle(list=VARMinimumRandomRotationAngleUsefulWhenR, amount=count)
VARMaximumRandomRotationAngleUsefulWhenR = Input(VARMaximumRandomRotationAngleUsefulWhenRandomizeRotationsisActivated: var[]..[])
count_2 = List.Count(list=angleAboutAxis@L2)
cycle_2 = List.Cycle(list=VARMaximumRandomRotationAngleUsefulWhenR, amount=count_2)
random = Math.Random(value1=cycle, value2=cycle_2)
flatten_3 = List.Flatten(list=random)
add_2 = flatten_2 + flatten_3
scopeIf = Custom[CW.ScopeIf+](VARtest=VARRandomizeRotations, VARtrue=add_2, VARfalse=flatten_2)  # A (hopefully) more robust implementation of ScopeIf. Tests a single boolean and returns a value accordingly.
scopeIf_2 = Custom[CW.ScopeIf+](VARtest=VARDisableRotations, VARtrue=code_block.out0, VARfalse=scopeIf)
clean_2 = List.Clean(list=scopeIf_2, preserveIndices=code_block.out1)
revit_links_batch_placement = Custom[Revit Links Batch Placement](VARRevitLinkType=VARRevitLinkType, VARLocations=flatten, VARRotations=clean_2)  # Revit Links Batch Placement (Link Reference 0 = Origin | 1 = Shared | 2 = Basepoint | 3 = Cenetered)
getLocation = Element.GetLocation(element=revit_links_batch_placement)
string_from_object = FromObject(obj=getLocation)
flatten_4 = List.Flatten(list=clean)
string_from_object_2 = FromObject(obj=flatten_4)
eq = string_from_object == string_from_object_2
Z = Point.Z(point=flatten)
bk_find_nearest_revit_level_for = Custom[BK.Find Nearest Revit Level for a Given Z value](VARzvalue=Z@L1)
flatten_5 = List.Flatten(list=bk_find_nearest_revit_level_for)
code_block_3 = CodeBlock { 0.01; }
roundToPrecision = Custom[CW.Math.RoundToPrecision](VARdbl=k_array_points_only.VARSpaces, VARprecision=code_block_3)  # Rounds a number to a specified precision
VARNumberofElementstoRemoveafterArrayNeg = Input(VARNumberofElementstoRemoveafterArrayNegativetoRemovefromtheEnd: var[]..[])
VARRemovefromBothStartandEnd = Input(VARRemovefromBothStartandEnd: var[]..[])
code_block_4 = CodeBlock { -1; 0; false; }
scopeIf_3 = Custom[CW.ScopeIf+](VARtest=VARRemovefromBothStartandEnd, VARtrue=code_block_4.out0, VARfalse=code_block_4.out1)
mul = VARNumberofElementstoRemoveafterArrayNeg * scopeIf_3
dropItems = List.DropItems(list=roundToPrecision@L2, amount=mul)
dropItems_2 = List.DropItems(list=roundToPrecision@L2, amount=VARNumberofElementstoRemoveafterArrayNeg)
equals = Custom[LF.IndexOf.Equals](VARlistA=dropItems_2@L2, VARlistB=dropItems@L2)  # Returns the indices of items in list B that are equal to items in list A.
getItemAtIndex = List.GetItemAtIndex(list=dropItems@L2, index=equals@L2)
VARSpacesReport = Output(getItemAtIndex)
count_3 = List.Count(list=k_array_points_only.VARPoints@L2)
cycle_3 = List.Cycle(list=VARRevitLinkType, amount=count_3)
count_4 = List.Count(list=cycle_3@L2)
count_5 = List.Count(list=VARRevitLinkType)
div = count_4 / count_5
takeItems = List.TakeItems(list=cycle_3, amount=div, lacing=Longest)
count_6 = List.Count(list=takeItems@L2)
abs = Math.Abs(number=VARNumberofElementstoRemoveafterArrayNeg)
sub = count_6 - abs
abs_2 = Math.Abs(number=mul)
sub_2 = sub - abs_2
scopeIf_4 = Custom[CW.ScopeIf+](VARtest=VARRemovefromBothStartandEnd, VARtrue=sub_2, VARfalse=sub)
VARNumberofFamiliesPlacedPerPath = Output(scopeIf_4)
flatten_6 = List.Flatten(list=revit_links_batch_placement)
count_7 = List.Count(list=flatten_6)
mul_2 = abs * k_array_points_only.VARNumberofPolycurves
sub_3 = count_7 - mul_2
mul_3 = abs_2 * k_array_points_only.VARNumberofPolycurves
sub_4 = sub_3 - mul_3
VARTotalFamiliesPlaced = Output(sub_4)
VARElements = Output(flatten_6)
join = List.Join()  # unwired: list0, list1
sublistLengths = Custom[CW.List.SublistLengths](VARseq=clean)  # Gets the lengths of all sublists in a given list of lists.
chopByLengths = Custom[CW.List.ChopByLengths](VARlengths=sublistLengths, VARlist=revit_links_batch_placement)  # Turns a list into a list of lists with sublists of varying lengths.
takeItems_2 = List.TakeItems(list=chopByLengths@L2, amount=VARNumberofElementstoRemoveafterArrayNeg)
takeItems_3 = List.TakeItems(list=chopByLengths@L2, amount=mul)
combine = List.Combine(comb=join, list1=takeItems_2, list2=takeItems_3)
clean_3 = List.Clean(list=combine, preserveIndices=code_block_4.out2)
flatten_7 = List.Flatten(list=clean_3)
passthrough = Custom[CW.Passthrough](VARpassThrough=flatten_7, VARwaitFor=getLocation)  # Forces a sequential order of execution. The node wired into the output of the Passthrough node will be executed *after* the node wired into the waitFor input (e.g. important for some Revit operations). The value of the passThrough input will be passed on to the node wired into the output port of the Passthrough node.
VARElementstoErase = Output(passthrough)
