# Dynamo custom node K-Attractor Circles Preview.dyf (Dynamo 2.1.0.7500)
# category: Synthesize.Automate.K-Attractor
# Preview Node for K-Attractor

VARCirclePreview = Input(VARCirclePreview: var[]..[])
code_block = CodeBlock { null; false; }
hot_get_all_filter = Custom[HOT.Get All Filter]()  # Get all Filter
selection_filter_to_read = StringInput("K-Attractor DO NOT DELETE")
eq = hot_get_all_filter.VARName == selection_filter_to_read
filterByBoolMask = List.FilterByBoolMask(list=hot_get_all_filter.VARElement, mask=eq)
scopeIf = Custom[CW.ScopeIf+](VARtest=VARCirclePreview, VARtrue=code_block.out0, VARfalse=filterByBoolMask.in)  # A (hopefully) more robust implementation of ScopeIf. Tests a single boolean and returns a value accordingly.
eraser = Custom[ST.Tool.Eraser](VARList=scopeIf)  # Try to delete any element from project
VARLocations = Input(VARLocations: var[]..[])
flatten = List.Flatten(list=VARLocations)
scopeIf_2 = Custom[CW.ScopeIf+](VARtest=VARCirclePreview, VARtrue=flatten, VARfalse=code_block.out0)
clean = List.Clean(list=scopeIf_2, preserveIndices=code_block.out1)
VARValuesGenerated = Input(VARValuesGenerated: var[]..[])
matchLength = Custom[LF.List.MatchLength](VARlistLength=VARLocations, VARlist=VARValuesGenerated)  # Cycle a list to match the length of the first list.
flatten_2 = List.Flatten(list=matchLength)
VARMinimumPreviewCircleRadius = Input(VARMinimumPreviewCircleRadius: var[]..[])
VARMaximumPreviewCircleRadius = Input(VARMaximumPreviewCircleRadius: var[]..[])
remapRange = Math.RemapRange(numbers=flatten_2, newMin=VARMinimumPreviewCircleRadius, newMax=VARMaximumPreviewCircleRadius)
scopeIf_3 = Custom[CW.ScopeIf+](VARtest=VARCirclePreview, VARtrue=remapRange, VARfalse=code_block.out0)
clean_2 = List.Clean(list=scopeIf_3, preserveIndices=code_block.out1)
byCenterPointRadius = Circle.ByCenterPointRadius(centerPoint=clean, radius=clean_2)
VARCirclesPreviewPlaneX = Input(VARCirclesPreviewPlaneX: var[]..[] = FalseY = True;)
YAxis = Vector.YAxis()
XAxis = Vector.XAxis()
scopeIf_4 = Custom[CW.ScopeIf+](VARtest=VARCirclesPreviewPlaneX, VARtrue=YAxis, VARfalse=XAxis)
VARCirclesPreviewDegree = Input(VARCirclesPreviewDegree: var[]..[])
rotate = Geometry.Rotate(geometry=byCenterPointRadius, origin=clean, axis=scopeIf_4, degrees=VARCirclesPreviewDegree)
byCurve = ModelCurve.ByCurve(curve=rotate)
VARCircles = Output(byCurve)
code_block_2 = CodeBlock { null; }
scopeIf_5 = Custom[CW.ScopeIf+](VARtest=VARCirclePreview, VARtrue=selection_filter_to_read, VARfalse=code_block_2)
elements = Custom[CW.SelectionSet.Elements](VARselectionSet=filterByBoolMask.in)  # Retrieves all elements stored in a selection set
flatten_3 = List.Flatten(list=elements)
eraser_2 = Custom[ST.Tool.Eraser](VARList=flatten_3)
passthrough = Custom[CW.Passthrough](VARpassThrough=scopeIf_5, VARwaitFor=eraser_2)  # Forces a sequential order of execution. The node wired into the output of the Passthrough node will be executed *after* the node wired into the waitFor input (e.g. important for some Revit operations). The value of the passThrough input will be passed on to the node wired into the output port of the Passthrough node.
flatten_4 = List.Flatten(list=byCurve)
passthrough_2 = Custom[CW.Passthrough](VARpassThrough=flatten_4, VARwaitFor=eraser_2)
byElements = Custom[CW.SelectionSet.ByElements](VARName=passthrough, VARelements=passthrough_2)  # Creates a selection set of the given elements. Note that if a selection set of the given name already exists in the model, its contents will be replaced. Also, if the selection set is already applied as a view filter, the view filter will have to be manually updated in the visibility / graphic overrides. DO ***NOT*** USE IN AUTOMATIC MODE!
VARSelectionSet = Output(byElements.VARselectionSet)
