# Dynamo custom node K-Attractor For Family Types.dyf (Dynamo 2.1.0.7500)
# category: Synthesize.Automate.K-Attractor
# K-Attractor For Family Types

VARProceed = Input(VARProceed: var[]..[])
VARAttractors = Input(VARAttractors: var[]..[])
VARFamilyName = Input(VARFamilyName: var[]..[])
VARReverseTypes = Input(VARReverseTypes: var[]..[])
VARAllTypesFalseforSpecificTypes = Input(VARAllTypesFalseforSpecificTypes: var[]..[])
byName = Family.ByName(name=VARFamilyName)
types = Family.Types(family=byName)
code_block = CodeBlock { null; }
scopeIf = Custom[CW.ScopeIf+](VARtest=VARAllTypesFalseforSpecificTypes, VARtrue=types, VARfalse=code_block)  # A (hopefully) more robust implementation of ScopeIf. Tests a single boolean and returns a value accordingly.
VARFamilyTypesList = Input(VARFamilyTypesList: var[]..[])
code_block_2 = CodeBlock { false; }
clean = List.Clean(list=VARFamilyTypesList, preserveIndices=code_block_2)
flatten = List.Flatten(list=clean)
contains = List.Contains(list=flatten, item=types@@L1)
filterByBoolMask = List.FilterByBoolMask(list=types, mask=contains)
uniqueItems = List.UniqueItems(list=filterByBoolMask.in)
scopeIf_2 = Custom[CW.ScopeIf+](VARtest=VARAllTypesFalseforSpecificTypes, VARtrue=code_block, VARfalse=uniqueItems)
create = List.Create(item0=scopeIf, item1=scopeIf_2)
code_block_3 = CodeBlock { false; }
clean_2 = List.Clean(list=create, preserveIndices=code_block_3)
flatten_2 = List.Flatten(list=clean_2@L2)
string_from_object = FromObject(obj=flatten_2)
code_block_4 = CodeBlock { "Family Type: Wall, Family: System Panel"; }
contains_2 = String.Contains(str=string_from_object, searchFor=code_block_4)
filterByBoolMask_2 = List.FilterByBoolMask(list=flatten_2, mask=contains_2)
name = FamilyType.Name(familyType=filterByBoolMask_2.out)
sort = List.Sort(list=name)
reverse = List.Reverse(list=sort@L2)
scopeIf_3 = Custom[CW.ScopeIf+](VARtest=VARReverseTypes, VARtrue=reverse, VARfalse=sort)
code_block_5 = CodeBlock { false; }
clean_3 = List.Clean(list=scopeIf_3, preserveIndices=code_block_5)
byFamilyNameAndTypeName = FamilyType.ByFamilyNameAndTypeName(familyName=VARFamilyName, typeName=clean_3)
all_elements_of_family_type = ElementsOfFamilyType(Family_Type=byFamilyNameAndTypeName)
flatten_3 = List.Flatten(list=all_elements_of_family_type)
VARAllElementsInActiveView = Input(VARAllElementsInActiveView: var[]..[])
contains_3 = List.Contains(list=VARAllElementsInActiveView, item=flatten_3@@L1)
filterByBoolMask_3 = List.FilterByBoolMask(list=flatten_3, mask=contains_3)
code_block_6 = CodeBlock { false; }
clean_4 = List.Clean(list=filterByBoolMask_3.in, preserveIndices=code_block_6)
flatten_4 = List.Flatten(list=clean_4)
k_attractor_sorter = Custom[K-Attractor Sorter](VARAttractors=VARAttractors, VARElements=flatten_4)  # K-Attractor Sorter
number = DoubleInput(0)
count = List.Count(list=k_attractor_sorter.VARGroupedandSortedElements)
number_2 = DoubleInput(1)
sequence = Sequence(start=number, amount=count, step=number_2, lacing=Longest)
getItemAtIndex = List.GetItemAtIndex(list=k_attractor_sorter.VARGroupedandSortedElements, index=sequence)
code_block_7 = CodeBlock { false; }
clean_5 = List.Clean(list=getItemAtIndex, preserveIndices=code_block_7)
code_block_8 = CodeBlock { null; }
scopeIf_4 = Custom[CW.ScopeIf+](VARtest=VARProceed, VARtrue=clean_5, VARfalse=code_block_8)
code_block_9 = CodeBlock { false; }
clean_6 = List.Clean(list=scopeIf_4, preserveIndices=code_block_9)
flatten_5 = List.Flatten(list=byFamilyNameAndTypeName)
count_2 = List.Count(list=getItemAtIndex)
cycle = List.Cycle(list=flatten_5, amount=count_2)
count_3 = List.Count(list=flatten_5)
chop = List.Chop(list=cycle, lengths=count_3)
start_number = DoubleInput(0)
code_block_10 = CodeBlock { 1; }
sequence_2 = Sequence(start=start_number, amount=count_2, step=code_block_10, lacing=Longest)
new_minimum_normalize_true = DoubleInput(0)
VARBalancedRhythmSeed = Input(VARBalancedRhythmSeed: var[]..[])
code_block_11 = CodeBlock { 1; }
sub = count_3 - code_block_11
VARCustomSeedValue = Input(VARCustomSeedValue: var[]..[])
scopeIf_5 = Custom[CW.ScopeIf+](VARtest=VARBalancedRhythmSeed, VARtrue=sub, VARfalse=VARCustomSeedValue)
remapRange = Math.RemapRange(numbers=sequence_2, newMin=new_minimum_normalize_true, newMax=scopeIf_5)
clean_7 = List.Clean(list=remapRange, preserveIndices=code_block_7)
rounding = DoubleInput(1)
roundToPrecision = Custom[CW.Math.RoundToPrecision](VARdbl=clean_7, VARprecision=rounding)  # Rounds a number to a specified precision
lt = sub < _  # unwired: y
replaceByCondition = Replace(item=roundToPrecision, replaceWith=sub, condition=lt)
getItemAtIndex_2 = List.GetItemAtIndex(list=chop, index=replaceByCondition, lacing=Longest)
setType = Custom[CW.FamilyInstance.SetType](VARfamilyInstance=clean_6, VARfamilyType=getItemAtIndex_2, lacing=Longest)  # Changes the family type of a given family instance to the specified type
VARFamilyInstance = Output(setType)
count_4 = List.Count(list=flatten_4)
VARNumberofTotalElements = Output(count_4)
VARBalancedSeedValue = Output(sub)
VARElementstoselect = Output(flatten_4)
VARTypesOrdertoUse = Output(scopeIf_3)
