# Dynamo custom node K-Attractor For Groups.dyf (Dynamo 2.1.0.7500)
# category: Synthesize.Automate.K-Attractor
# K-Attractor For Family Types

VARProceed = Input(VARProceed: var[]..[])
VARAttractors = Input(VARAttractors: var[]..[])
VARgroupInstances = Input(VARgroupInstances: var[]..[])
flatten = List.Flatten(list=VARgroupInstances)
VARSelectedGroups = Input(VARSelectedGroups: var[]..[])
code_block = CodeBlock { "Group"; }
filterByString = Custom[ST.List.FilterByString](VARlist=VARSelectedGroups, VARString=code_block)  # Filter a list by a string match
contains = List.Contains(list=filterByString.VARMatch, item=flatten@@L1)
filterByBoolMask = List.FilterByBoolMask(list=flatten, mask=contains)
code_block_2 = CodeBlock { false; }
clean = List.Clean(list=filterByBoolMask.in, preserveIndices=code_block_2)
flatten_2 = List.Flatten(list=clean)
k_attractor_sorter = Custom[K-Attractor Sorter](VARAttractors=VARAttractors, VARElements=flatten_2)  # K-Attractor Sorter
number = DoubleInput(0)
count = List.Count(list=k_attractor_sorter.VARGroupedandSortedElements)
number_2 = DoubleInput(1)
sequence = Sequence(start=number, amount=count, step=number_2, lacing=Longest)
getItemAtIndex = List.GetItemAtIndex(list=k_attractor_sorter.VARGroupedandSortedElements, index=sequence)
code_block_3 = CodeBlock { false; }
clean_2 = List.Clean(list=getItemAtIndex, preserveIndices=code_block_3)
code_block_4 = CodeBlock { null; }
scopeIf = Custom[CW.ScopeIf+](VARtest=VARProceed, VARtrue=clean_2, VARfalse=code_block_4)  # A (hopefully) more robust implementation of ScopeIf. Tests a single boolean and returns a value accordingly.
code_block_5 = CodeBlock { false; }
clean_3 = List.Clean(list=scopeIf, preserveIndices=code_block_5)
code_block_6 = CodeBlock { "Type"; }
VARReverseTypes = Input(VARReverseTypes: var[]..[])
VARgroupTypes = Input(VARgroupTypes: var[]..[])
reverse = List.Reverse(list=VARgroupTypes)
scopeIf_2 = Custom[CW.ScopeIf+](VARtest=VARReverseTypes, VARtrue=reverse, VARfalse=VARgroupTypes)
count_2 = List.Count(list=getItemAtIndex)
cycle = List.Cycle(list=scopeIf_2, amount=count_2)
count_3 = List.Count(list=scopeIf_2)
chop = List.Chop(list=cycle, lengths=count_3)
start_number = DoubleInput(0)
code_block_7 = CodeBlock { 1; }
sequence_2 = Sequence(start=start_number, amount=count_2, step=code_block_7, lacing=Longest)
new_minimum_normalize_true = DoubleInput(0)
VARBalancedRhythmSeed = Input(VARBalancedRhythmSeed: var[]..[])
code_block_8 = CodeBlock { 1; }
sub = count_3 - code_block_8
VARCustomSeedValue = Input(VARCustomSeedValue: var[]..[])
scopeIf_3 = Custom[CW.ScopeIf+](VARtest=VARBalancedRhythmSeed, VARtrue=sub, VARfalse=VARCustomSeedValue)
remapRange = Math.RemapRange(numbers=sequence_2, newMin=new_minimum_normalize_true, newMax=scopeIf_3)
clean_4 = List.Clean(list=remapRange, preserveIndices=code_block_3)
rounding = DoubleInput(1)
roundToPrecision = Custom[CW.Math.RoundToPrecision](VARdbl=clean_4, VARprecision=rounding)  # Rounds a number to a specified precision
lt = sub < _  # unwired: y
replaceByCondition = Replace(item=roundToPrecision, replaceWith=sub, condition=lt)
getItemAtIndex_2 = List.GetItemAtIndex(list=chop, index=replaceByCondition, lacing=Longest)
setParameterByName = Element.SetParameterByName(element=clean_3, parameterName=code_block_6, value=getItemAtIndex_2)
VARGroupInstance = Output(setParameterByName)
count_4 = List.Count(list=flatten_2)
VARNumberofTotalGroups = Output(count_4)
VARBalancedSeedValue = Output(sub)
VARGroupstoselect = Output(flatten_2)
VARTypesOrdertoUse = Output(scopeIf_2)
