# Dynamo custom node K-Attractor For Materials.dyf (Dynamo 2.1.0.7500)
# category: Synthesize.Automate.K-Attractor
# K-Attractor For Family Types

VARReverseMaterials = Input(VARReverseMaterials: var[]..[])
VARMaterialstoAttract = Input(VARMaterialstoAttract: var[]..[])
VARSeperationSymbol = Input(VARSeperationSymbol: var[]..[])
split = String.Split(str=VARMaterialstoAttract, separator0=VARSeperationSymbol)
trimWhitespace = String.TrimWhitespace(str=split)
byName = Material.ByName(name=trimWhitespace)
code_block = CodeBlock { false; }
clean = List.Clean(list=byName, preserveIndices=code_block)
flatten = List.Flatten(list=clean)
reverse = List.Reverse(list=flatten)
scopeIf = Custom[CW.ScopeIf+](VARtest=VARReverseMaterials, VARtrue=reverse, VARfalse=flatten)  # A (hopefully) more robust implementation of ScopeIf. Tests a single boolean and returns a value accordingly.
count = List.Count(list=scopeIf)
code_block_2 = CodeBlock { 1; }
sub = count - code_block_2
flatten_2 = List.Flatten(list=sub)
VARBalancedSeedValue = Output(flatten_2)
VARMaterialsOrdertoUse = Output(scopeIf)
VARProceed = Input(VARProceed: var[]..[])
VARAttractors = Input(VARAttractors: var[]..[])
VARElementstoWorkon = Input(VARElementstoWorkon: var[]..[])
VARMaterialParameters = Input(VARMaterialParameters: var[]..[])
parameterExists = Custom[CW.Element.ParameterExists](VARparam=VARMaterialParameters, VARelement=VARElementstoWorkon)  # Checks if an element contains a parameter of a given name
transpose = List.Transpose(lists=parameterExists)
allTrue = List.AllTrue(list=transpose@L2)
filterByBoolMask = List.FilterByBoolMask(list=VARElementstoWorkon, mask=allTrue)
flatten_3 = List.Flatten(list=filterByBoolMask.in)
turnIntoList = Custom[CW.TurnIntoList](VARunknownItem=flatten_3)  # Turns an element (or a nested list) into a flat list
flatten_4 = List.Flatten(list=turnIntoList)
uniqueItems = List.UniqueItems(list=flatten_4)
flatten_5 = List.Flatten(list=uniqueItems)
VARAllElementsInActiveView = Input(VARAllElementsInActiveView: var[]..[])
contains = List.Contains(list=VARAllElementsInActiveView, item=flatten_5@@L1)
filterByBoolMask_2 = List.FilterByBoolMask(list=flatten_5, mask=contains)
code_block_3 = CodeBlock { false; }
clean_2 = List.Clean(list=filterByBoolMask_2.in, preserveIndices=code_block_3)
flatten_6 = List.Flatten(list=clean_2)
k_attractor_sorter = Custom[K-Attractor Sorter](VARAttractors=VARAttractors, VARElements=flatten_6)  # K-Attractor Sorter
number = DoubleInput(0)
count_2 = List.Count(list=k_attractor_sorter.VARGroupedandSortedElements)
number_2 = DoubleInput(1)
sequence = Sequence(start=number, amount=count_2, step=number_2, lacing=Longest)
getItemAtIndex = List.GetItemAtIndex(list=k_attractor_sorter.VARGroupedandSortedElements, index=sequence)
code_block_4 = CodeBlock { false; }
clean_3 = List.Clean(list=getItemAtIndex, preserveIndices=code_block_4)
code_block_5 = CodeBlock { null; }
scopeIf_2 = Custom[CW.ScopeIf+](VARtest=VARProceed, VARtrue=clean_3, VARfalse=code_block_5)
code_block_6 = CodeBlock { false; }
clean_4 = List.Clean(list=scopeIf_2, preserveIndices=code_block_6)
uniqueItems_2 = List.UniqueItems(list=VARMaterialParameters)
parameterExists_2 = Custom[CW.Element.ParameterExists](VARparam=uniqueItems_2, VARelement=flatten_4)
allTrue_2 = List.AllTrue(list=parameterExists_2@L2)
filterByBoolMask_3 = List.FilterByBoolMask(list=uniqueItems_2, mask=allTrue_2)
count_3 = List.Count(list=getItemAtIndex)
cycle = List.Cycle(list=scopeIf, amount=count_3)
chop = List.Chop(list=cycle, lengths=count)
start_number = DoubleInput(0)
code_block_7 = CodeBlock { 1; }
sequence_2 = Sequence(start=start_number, amount=count_3, step=code_block_7, lacing=Longest)
new_minimum_normalize_true = DoubleInput(0)
VARBalancedRhythmSeed = Input(VARBalancedRhythmSeed: var[]..[])
VARCustomSeedValue = Input(VARCustomSeedValue: var[]..[])
scopeIf_3 = Custom[CW.ScopeIf+](VARtest=VARBalancedRhythmSeed, VARtrue=flatten_2, VARfalse=VARCustomSeedValue)
remapRange = Math.RemapRange(numbers=sequence_2, newMin=new_minimum_normalize_true, newMax=scopeIf_3)
clean_5 = List.Clean(list=remapRange, preserveIndices=code_block_4)
rounding = DoubleInput(1)
roundToPrecision = Custom[CW.Math.RoundToPrecision](VARdbl=clean_5, VARprecision=rounding)  # Rounds a number to a specified precision
lt = sub < _  # unwired: y
replaceByCondition = Replace(item=roundToPrecision, replaceWith=sub, condition=lt)
getItemAtIndex_2 = List.GetItemAtIndex(list=chop, index=replaceByCondition, lacing=Longest)
count_4 = List.Count(list=filterByBoolMask_3.in)
ofRepeatedItem = List.OfRepeatedItem(item=getItemAtIndex_2, amount=count_4)
setParameterByName = Element.SetParameterByName(element=clean_4, parameterName=filterByBoolMask_3.in@L1, value=ofRepeatedItem@@L2)
count_5 = List.Count(list=flatten_3)
VARNumberofTotalElements = Output(count_5)
VARElementstoselect = Output(flatten_3)
watch = Watch(count_4)
