# Dynamo custom node K-Clash.dyf (Dynamo 2.13.1.3887)
# category: Synthesize.Automate.Clash Detection
# K-Clash
# packages: Synthesize toolkit 12.5.5

VARFilePath = Input(VARFilePath: var[]..[])
VARInterferenceFamily = Input(VARInterferenceFamily: var[]..[])
VARMode1NewMarkers2NewViews3CleanupMarke = Input(VARMode1NewMarkers2NewViews3CleanupMarkers4CleanupViews5Cleanupall: int = 1)
VARCleanupalongtheway = Input(VARCleanupalongtheway: bool = true)
VARKClashViewsPrefix = Input(VARKClashViewsPrefix: string = "KClash")
VARKClashViewsSectionBoxExtraOffsetMeter = Input(VARKClashViewsSectionBoxExtraOffsetMeters: double = 1)
metersInput = Custom[MetersInput](VARInput=VARKClashViewsSectionBoxExtraOffsetMeter)  # package Synthesize toolkit; MetersInput
VARSetGenerate3DAlwaysOn = Input(VARSetGenerate3DAlwaysOn: bool = true)
VARGenerate3DViewsforFixedClashes = Input(VARGenerate3DViewsforFixedClashes: bool = true)
VARFirstElementMarkParameter = Input(VARFirstElementMarkParameter: string = "Mark")
VARSecondElementMarkParameter = Input(VARSecondElementMarkParameter: string = "Mark")
VARInterferenceParametersGenerate3DParam = Input(VARInterferenceParametersGenerate3DParameterYesNo: string = "KClash_Generate 3D")
VARInterferenceParametersIsFixedParamete = Input(VARInterferenceParametersIsFixedParameterYesNo: string = "KClash_Is Fixed")
VARInterferenceParametersClashCategoryPa = Input(VARInterferenceParametersClashCategoryParameterText: string = "KClash_Category")
VARInterferenceParametersClashLevelParam = Input(VARInterferenceParametersClashLevelParameterText: string = "KClash_Level")
VARInterferenceParametersApproxClashValu = Input(VARInterferenceParametersApproxClashValueParameterLengthorNumber: string = "KClash_Distance")
VARInterferenceParametersIDOneParameterT = Input(VARInterferenceParametersIDOneParameterTextorInteger: string = "KClash_IDone")
VARInterferenceParametersIDTwoParameterT = Input(VARInterferenceParametersIDTwoParameterTextorInteger: string = "KClash_IDtwo")
VARInterferenceParametersLinkNameParamet = Input(VARInterferenceParametersLinkNameParameterText: string = "KClash_Link Name")
VARInterferenceParametersSectionBoxDataP = Input(VARInterferenceParametersSectionBoxDataParameterText: string = "Data Storage")
VARInterferenceParametersClashNameParame = Input(VARInterferenceParametersClashNameParameterText: string = "KClash_Name")
VARInterferenceParametersClashStatusPara = Input(VARInterferenceParametersClashStatusParameterText: string = "KClash_Status")
VARInterferenceParametersClashDescriptio = Input(VARInterferenceParametersClashDescriptionParameterText: string = "KClash_Description")
VARInterferenceParametersClashCommentsPa = Input(VARInterferenceParametersClashCommentsParameterText: string = "KClash_Comments")
VARInterferenceParametersTestNameParamet = Input(VARInterferenceParametersTestNameParameterText: string = "KClash_Test Name")
VARInterferenceParametersGroupParameterT = Input(VARInterferenceParametersGroupParameterText: string = "KClash_Group")
VARInterferenceParametersDateParameterTe = Input(VARInterferenceParametersDateParameterText: string = "KClash_Date")
VARInterferenceParametersAssignedToParam = Input(VARInterferenceParametersAssignedToParameterText: string = "KClash_Assigned To")
VARInterferenceParametersApprovedByParam = Input(VARInterferenceParametersApprovedByParameterText: string = "KClash_Approved By")
VARInterferenceParametersApprovedDatePar = Input(VARInterferenceParametersApprovedDateParameterText: string = "KClash_Approval Date")
VARInterferenceParametersClashGUIDParame = Input(VARInterferenceParametersClashGUIDParameterText: string = "GUID")
VARTolleranceInMillimeters = Input(VARTolleranceInMillimeters: double = 1)
python_script = Python(IN[0]=VARFilePath, IN[1]=VARInterferenceFamily, IN[2]=VARMode1NewMarkers2NewViews3CleanupMarke, IN[3]=VARCleanupalongtheway, IN[4]=VARKClashViewsPrefix, IN[5]=metersInput, IN[6]=VARSetGenerate3DAlwaysOn, IN[7]=VARGenerate3DViewsforFixedClashes, IN[8]=VARFirstElementMarkParameter, IN[9]=VARSecondElementMarkParameter, IN[10]=VARInterferenceParametersGenerate3DParam, IN[11]=VARInterferenceParametersIsFixedParamete, IN[12]=VARInterferenceParametersClashCategoryPa, IN[13]=VARInterferenceParametersClashLevelParam, IN[14]=VARInterferenceParametersApproxClashValu, IN[15]=VARInterferenceParametersIDOneParameterT, IN[16]=VARInterferenceParametersIDTwoParameterT, IN[17]=VARInterferenceParametersLinkNameParamet, IN[18]=VARInterferenceParametersSectionBoxDataP, IN[19]=VARInterferenceParametersClashNameParame, IN[20]=VARInterferenceParametersClashStatusPara, IN[21]=VARInterferenceParametersClashDescriptio, IN[22]=VARInterferenceParametersClashCommentsPa, IN[23]=VARInterferenceParametersTestNameParamet, IN[24]=VARInterferenceParametersGroupParameterT, IN[25]=VARInterferenceParametersDateParameterTe, IN[26]=VARInterferenceParametersAssignedToParam, IN[27]=VARInterferenceParametersApprovedByParam, IN[28]=VARInterferenceParametersApprovedDatePar, IN[29]=VARInterferenceParametersClashGUIDParame, IN[30]=VARTolleranceInMillimeters)  # IronPython2
# ---------- python_script.python (1411 lines) ----------
# Created By Karam Baki : karam@aecedx.com
# IMPORTANT : ALL DYNAMO DESIGN SCRIPT NODES ARE AS (dg)
import clr
import math
clr.AddReference('ProtoGeometry')
from Autodesk.DesignScript import Geometry as dg

# EXTENSION Enable ToDSType
clr.AddReference('RevitNodes')
import Revit
clr.ImportExtensions(Revit.Elements)

import System
pf_path = System.Environment.GetFolderPath(System.Environment.SpecialFolder.ProgramFilesX86)
import sys
sys.path.append('%s\IronPython 2.7\Lib' %pf_path)

clr.AddReference('DynamoRevitDS')
import Dynamo
scriptfullpath = Dynamo.Applications.DynamoRevit().RevitDynamoModel.CurrentWorkspace.FileName	
ironpython_path = scriptfullpath.split("\\")[:-3]
ironpython_path.append("DynamoIronPython2.7")
ironpython_path.append("extra")
ironpython_path.append("IronPython.StdLib.2.7.9")
sys.path.Insert(1,"\\".join(ironpython_path))
sys.path.Insert(2,"\\".join(scriptfullpath.split("\\")[:-1]))

from sgmllib import SGMLParser
from collections import Counter

# Enable Revit Elements
from Revit.Elements import *

# EXTENSION Enable Geometry Conversion Methods
clr.ImportExtensions(Revit.GeometryConversion)

# Enable Revit API
clr.AddReference('RevitAPI')
from Autodesk.Revit.DB import *

# Enable DocumentManager and TransactionManager
clr.AddReference('RevitServices')
from RevitServices.Persistence import DocumentManager
from RevitServices.Transactions import TransactionManager

# Enable ICollection List Translate
clr.AddReference("System")
import System.Collections.Generic
from System.Collections.Generic import List
from itertools import compress
from itertools import combinations

from bisect import bisect_left

clr.AddReference("RevitAPIUI")
from Autodesk.Revit.UI import TaskDialog

clr.AddReference('DynamoRevitDS')
import Dynamo 
import os

import random

doc = DocumentManager.Instance.CurrentDBDocument
uidoc = DocumentManager.Instance.CurrentUIApplication.ActiveUIDocument
uiapp = DocumentManager.Instance.CurrentUIApplication
app = uiapp.Application

def flatten(x):
    result = []
    for el in x:
        if hasattr(el, "__iter__") and not isinstance(el, basestring):
            result.extend(flatten(el))
        else:
            result.append(el)
    return result

def take_closest(myList, myNumber):
    pos = bisect_left(myList, myNumber)
    if pos == 0:
        return myList[0]
    if pos == len(myList):
        return myList[-1]
    before = myList[pos - 1]
    after = myList[pos]
    if after - myNumber < myNumber - before:
        return after
    else:
        return before

# Parsing Technique Created By Dimitar Venkov
class ReportParser(SGMLParser):
	def __init__(self, verbose=0):
		SGMLParser.__init__(self, verbose)
		self.data1 = []
		self.temp_data = []
	def handle_data(self, data):
		if data != "\n" and data not in known_errors:
			self.temp_data.append(data)
	def unknown_starttag(self, tag, attrs):
		if tag == "tr":
			self.data1.append(self.temp_data)
			self.temp_data = []

interference_cats = {"Structural Columns", "Air Terminals", "Assemblies", "Cable Tray Fittings", "Cable Tray Runs", "Cable Trays", "Casework", "Ceilings", "Columns", "Conduit Fittings", "Conduit Runs", "Conduits", "Curtain Panels", "Curtain Systems", "Curtain Wall Mullions","Doors", "Ducts", "Duct Accessories", "Duct Fittings", "Duct Insulations", "Duct Linings", "Duct Placeholders", "Duct Systems", "Electrical Circuits", "Electrical Equipment", "Electrical Fixtures", "Fabrication Parts", "Flex Ducts", "Flex Pipes", "Floors", "Furniture", "Furniture Systems", "Generic Models", "Gutters", "Lighting Devices", "Lighting Fixtures", "Mass Floors", "Mass", "Mechanical Equipment", "Pads", "Parts", "Pipe Accessories", "Pipe Fittings", "Pipe Insulations", "Pipe Placeholders", "Pipes", "Piping Systems",  "Plumbing Fixtures", "Railings", "Ramps", "Roofs", "Roof Soffits", "Shaft Openings", "Slab Edges", "Specialty Equipment", "Sprinklers", "Stairs", "Structural Connections", "Structural Foundations", "Structural Framing", "Structural Trusses", "Wall Sweeps", "Walls", "Windows", "Wires"}

def getElement(IgnoreErrors,i,document,documentName):
	try:
		if documentName == not_linked_string:
			return doc.GetElement(ElementId(i))
		elif documentName == link_not_loaded_string and not IgnoreErrors:
			return error_string
		else:
			return document.GetElement(ElementId(i))
	except:
		if IgnoreErrors:
			return i
		else:
			return error_string

def fetchCat(items, interference_cats=interference_cats):
	for i in items:
		if i in interference_cats:
			return i

def idparamHandle(element,idoneparam,id):
	stopIt = False
	idone = element.LookupParameter(idoneparam)
	if idone != None:
		if idone.StorageType == StorageType.String:
			if isinstance(id, str):
				idone.Set(id)
			else:
				idone.Set(id.ToString())
		elif idone.StorageType == StorageType.Integer:
			if isinstance(id, str):
				idone.Set(-1)
			else:
				idone.Set(id.IntegerValue)
		else:
			stopIt = True
	else:
		stopIt = True
	return stopIt

def paramHandle(element,param,value):
	stopIt = False
	param = element.LookupParameter(param)
	if param != None:
		param.Set(value)
	else:
		stopIt = True
	return stopIt

def paramGet(element,param):
	param = element.LookupParameter(param)
	if param != None:
		if param.StorageType == StorageType.String:
			if param.HasValue:
				return param.AsString()
			else:
				return "None"
		elif param.StorageType == StorageType.Integer:
			if param.HasValue:
				return param.AsInteger().ToString()
			else:
				return "None"
	return param

def bboxValue(bbox):
	try:
		cuboid = bbox.ToCuboid()
		value = (cuboid.Height + cuboid.Length + cuboid.Width)/3
		volume = cuboid.Volume
		cuboid.Dispose()
		return value,volume
	except:
		return None,None

def markParamhandle(element,markparam):
	if hasattr(element, 'LookupParameter'):
		markparam = element.LookupParameter(markparam)
		if markparam == None:
			return ""
		else:
			if markparam.StorageType == StorageType.String:
				markparam = markparam.AsString()
			else:
				markparam = markparam.AsValueString()
			if markparam == None:
				return ""
			else:
				return markparam
	else:
		return ""

def unitsHandle(units):
	if units == "m":
		return 3.28084
	elif units == "mm":
		return 0.00328084
	elif units == "cm":
		return 0.0328084
	elif units == "in":
		return 0.0833333
	else:
		return 1
		
def getTitle(doc):
	title = doc.Title.Replace("_detached","")
	if title.endswith(".rfa"):
		title.replace(".rfa",".rvt")
	elif title.endswith(".rte"):
		title.replace(".rte",".rvt")
	elif title.endswith("rvt") == False:
		title += ".rvt"
	return title	

def smarttagsHandle(clashObj,unknown_string):
	smarttags_1 = clashObj.getElementsByTagName('smarttags')[0].childNodes
	project_name_found = False
	project_1_name = unknown_string
	category_1_name = unknown_string
	clash_1_id = -1
	for smarttag_1 in smarttags_1:
		try:
			name = smarttag_1.getElementsByTagName('name')[0].firstChild.data
		except:
			continue
		if name == "Element Id":
			try:
				clash_1_id = smarttag_1.getElementsByTagName('value')[0].firstChild.data
			except:
				pass
		elif project_name_found == False and name == "Item Source File":
			try:
				project_1_name = smarttag_1.getElementsByTagName('value')[0].firstChild.data.Replace("_detached","")
				project_name_found = True
			except:
				pass
		elif project_name_found == False and name == "Document Title":
			try:
				project_1_name = smarttag_1.getElementsByTagName('value')[0].firstChild.data.Replace("_detached","") + ".rvt"
				project_name_found = True
			except:
				pass
		elif name == "Element Category" or name == "Category Name":
			try:
				category_1_name = smarttag_1.getElementsByTagName('value')[0].firstChild.data
			except:
				pass
	return project_1_name,category_1_name,clash_1_id

def clashData(report,units,doc,title,andsym,linksData,link_not_loaded_string,not_linked_string,FromInternalfactor,surveyTransform,currentGuids,InterInstancesIntegers,not_existed_string,unknown_string):
	groups_names = []
	groups_comments = []
	group_guids = []
	groups_data = report.getElementsByTagName('clashgroup')
	if len(groups_data) > 0:
		for group_data in groups_data:
			childgroup_nodes = group_data.childNodes
			commentsObj_All = []
			for child in childgroup_nodes:
				if child.nodeName == "comments":
					commentsObj_All = child.getElementsByTagName('comment')
				if child.nodeName == "clashresults":
					clashresults_data = child.getElementsByTagName('clashresult')
					tmp_guids = []
					for clashresult_data in clashresults_data:
						tmp_guids.append(clashresult_data.attributes['guid'].value)
			if len(commentsObj_All) > 0:
				comments = []
				for commentObj in commentsObj_All:
					tmp = []
					comment_date = commentObj.getElementsByTagName('date')[0]
					comment_date = comment_date.attributes['year'].value + "/" + comment_date.attributes['month'].value + "/" + comment_date.attributes['day'].value + " " + comment_date.attributes['hour'].value + ":" + comment_date.attributes['minute'].value
					tmp.append("Group Comment Id: " + commentObj.attributes['id'].value)
					tmp.append("Group Comment Status: " + commentObj.attributes['status'].value)
					tmp.append("Group Comment By: " + commentObj.getElementsByTagName('user')[0].firstChild.data)
					tmp.append("Group Comment Date: " + comment_date)
					tmp.append("Group Comment: " + commentObj.getElementsByTagName('body')[0].firstChild.data)
					tmp.append("\n")
					comments.append("\r\n".join(tmp))
				groups_names.append(group_data.attributes['name'].value)
				groups_comments.append(comments)
				group_guids.append(tmp_guids)
			
	megaOutput = []
	tests = report.getElementsByTagName('clashtest')
	for test in tests:
		testName = test.attributes['name'].value
		clashes = test.getElementsByTagName('clashresult')
		for clash in clashes:
			try:
				factor = unitsHandle(units)
				is_orphan = False
				clashObj_All = clash.getElementsByTagName('clashobjects')[0].getElementsByTagName('clashobject')
				clashObj_1 = clashObj_All[0]
				if len(clashObj_All) < 2:
					clashObj_2 = clashObj_All[0]
					is_orphan = True
				else:
					clashObj_2 = clashObj_All[1]
				dates_data = clash.getElementsByTagName('date')
				clashpoint_data = clash.getElementsByTagName('pos3f')[0]
				project_1_data = smarttagsHandle(clashObj_1,unknown_string)
				project_2_data = smarttagsHandle(clashObj_2,unknown_string)
			
				status = clash.attributes['status'].value.capitalize()
				clashname = clash.attributes['name'].value
				clashguid = clash.attributes['guid'].value
				group = clash.getElementsByTagName('parentgroup')
				if len(group) > 0:
					group = group[0].firstChild.data
				else:
					group = ""
				description = clash.getElementsByTagName('description')[0].firstChild.data
				project_1_name = project_1_data[0]
				if project_1_name == unknown_string:
					continue
				project_1_category = project_1_data[1]
				project_2_name = project_2_data[0]
				if project_2_name == unknown_string:
					continue
				project_2_category = project_2_data[1]
				clash_date = dates_data[0].attributes['year'].value + "/" + dates_data[0].attributes['month'].value + "/" + dates_data[0].attributes['day'].value + " " + dates_data[0].attributes['hour'].value + ":" + dates_data[0].attributes['minute'].value
				distance = float(clash.attributes['distance'].value)*factor
				clashpoint_x = float(clashpoint_data.attributes['x'].value)*factor
				clashpoint_y = float(clashpoint_data.attributes['y'].value)*factor
				clashpoint_z = float(clashpoint_data.attributes['z'].value)*factor
				
				approvedby = clash.getElementsByTagName('approvedby')
				if len(approvedby) > 0:
					approvedby = approvedby[0].firstChild.data
					approvedDate = dates_data[1].attributes['year'].value + "/" + dates_data[1].attributes['month'].value + "/" + dates_data[1].attributes['day'].value + " " + dates_data[1].attributes['hour'].value + ":" + dates_data[1].attributes['minute'].value
				else:
					approvedby = ""
					approvedDate = ""
					
				assignedto = clash.getElementsByTagName('assignedto')
				if len(assignedto) > 0:
					assignedto = assignedto[0].firstChild.data
				else:
					assignedto = ""
				
				try:
					clash_1_objectattribute = clashObj_1.getElementsByTagName('objectattribute')[0]
					clash_1_type = clash_1_objectattribute.getElementsByTagName('name')[0].firstChild.data
				except:
					clash_1_objectattribute = None
					clash_1_type = None
					
				try:
					clash_2_objectattribute = clashObj_2.getElementsByTagName('objectattribute')[0]
					clash_2_type = clash_2_objectattribute.getElementsByTagName('name')[0].firstChild.data
				except:
					clash_2_objectattribute = None
					clash_2_type = None
		
				if clash_1_type == "GUID":
					clash_1_is_guid = True
				else:
					clash_1_is_guid = False
				if clash_2_type == "GUID":
					clash_2_is_guid = True
				else:
					clash_2_is_guid = False
				
				if clash_1_is_guid:
					try:
						clash_1_id = clash_1_objectattribute.getElementsByTagName('value')[0].firstChild.data
					except:
						clash_1_id = int(project_1_data[2])
				else:
					clash_1_id = int(project_1_data[2])
				if clash_2_is_guid:
					try:
						clash_2_id = clash_2_objectattribute.getElementsByTagName('value')[0].firstChild.data
					except:
						clash_2_id = int(project_2_data[2])
				else:
					clash_2_id = int(project_2_data[2])
				
				
				if clash_1_id == -1:
					try:
						clash_1_id = clash_1_objectattribute.getElementsByTagName('value')[0].firstChild.data
					except:
						pass
				if clash_2_id == -1:
					try:
						clash_2_id = clash_2_objectattribute.getElementsByTagName('value')[0].firstChild.data
					except:
						pass
				
				if project_1_name == title:
					self_1 = True
				else:
					self_1 = False
				if project_2_name == title:
					self_2 = True
				else:
					self_2 = False
				if self_1 and self_2:
					guids_1 = currentGuids
					guids_2 = currentGuids
					if clash_1_is_guid and clash_1_id in guids_1[0]:
						clash_1_id = guids_1[1][guids_1[0].IndexOf(clash_1_id)].IntegerValue
					if clash_2_is_guid and clash_2_id in guids_2[0]:
						clash_2_id = guids_2[1][guids_2[0].IndexOf(clash_2_id)].IntegerValue
					if clash_1_id in InterInstancesIntegers or clash_2_id in InterInstancesIntegers:
						return None
					pair = [getElement(True,clash_1_id,None,not_linked_string),getElement(True,clash_2_id,None,not_linked_string)]
					if pair[0] == None or pair[0] == -1:
						if not is_orphan:
							continue
						else:
							pair[0] = not_existed_string
					if pair[1] == None or pair[1] == -1:
						if not is_orphan:
							continue
						else:
							pair[1] = not_existed_string
					case = andsym.join([project_1_category,project_2_category])
					documentName = not_linked_string
					document = None
					transform = None
				elif not self_1 and not self_2:
					if not is_orphan:
						continue
					else:
						pair = [not_existed_string, not_existed_string]
				elif self_1:
					document = None
					transform = None
					guids_1 = currentGuids
					documentName = project_2_name
					for linkData in linksData:
						if documentName.lower() == linkData[2].lower():
							document = linkData[1]
							transform = linkData[3]
							guids_2 = linkData[4]
							break
					if document != None:
						if clash_1_is_guid and clash_1_id in guids_1[0]:
							clash_1_id = guids_1[1][guids_1[0].IndexOf(clash_1_id)].IntegerValue
						if clash_2_is_guid and clash_2_id in guids_2[0]:
							clash_2_id = guids_2[1][guids_2[0].IndexOf(clash_2_id)].IntegerValue
					if clash_1_id in InterInstancesIntegers or clash_2_id in InterInstancesIntegers:
						continue
					pair = [getElement(True,clash_1_id,None,not_linked_string),getElement(True,clash_2_id,document,documentName)]
					if pair[0] == None or pair[0] == -1:
						if not is_orphan:
							continue
						else:
							pair[0] = not_existed_string
					if pair[1] == None or pair[1] == -1:
						pair[1] = clashguid
					case = andsym.join([project_1_category,project_2_category])
				elif self_2:
					document = None
					transform = None
					guids_2 = currentGuids
					documentName = project_1_name
					for linkData in linksData:
						if documentName.lower() == linkData[2].lower():
							document = linkData[1]
							transform = linkData[3]
							guids_1 = linkData[4]
							break
					if document != None:
						if clash_1_is_guid and clash_1_id in guids_1[0]:
							clash_1_id = guids_1[1][guids_1[0].IndexOf(clash_1_id)].IntegerValue
						if clash_2_is_guid and clash_2_id in guids_2[0]:
							clash_2_id = guids_2[1][guids_2[0].IndexOf(clash_2_id)].IntegerValue
					if clash_1_id in InterInstancesIntegers or clash_2_id in InterInstancesIntegers:
						continue
					pair = [getElement(True,clash_2_id,None,not_linked_string),getElement(True,clash_1_id,document,documentName)]
					if pair[0] == None or pair[0] == -1:
						if not is_orphan:
							continue
						else:
							pair[0] = not_existed_string
					if pair[1] == None or pair[1] == -1:
						pair[1] = clashguid
					case = andsym.join([project_2_category,project_1_category])
					
				clashpoint = surveyTransform.OfPoint(XYZ(clashpoint_x,clashpoint_y,clashpoint_z)).ToPoint()
				commentsObj_All = clash.getElementsByTagName('comments')
				comments = ""
				extra_comments_indexs = [i for i in range(len(groups_names)) if groups_names[i] == group]
				for extra_comments_index in extra_comments_indexs:
					extra_comments = groups_comments[extra_comments_index]
					extra_guids = group_guids[extra_comments_index]
					if clash.attributes['guid'].value in extra_guids:
						comments = []
						for extra_comment in extra_comments:
							comments.append(extra_comment)
				if len(commentsObj_All) > 0:
					commentsObj_All = commentsObj_All[0].getElementsByTagName('comment')
					if comments == "":
						comments = []
					for commentObj in commentsObj_All:
						tmp = []
						comment_date = commentObj.getElementsByTagName('date')[0]
						comment_date = comment_date.attributes['year'].value + "/" + comment_date.attributes['month'].value + "/" + comment_date.attributes['day'].value + " " + comment_date.attributes['hour'].value + ":" + comment_date.attributes['minute'].value
						tmp.append("Comment Id: " + commentObj.attributes['id'].value)
						tmp.append("Comment Status: " + commentObj.attributes['status'].value)
						tmp.append("Comment By: " + commentObj.getElementsByTagName('user')[0].firstChild.data)
						tmp.append("Comment Date: " + comment_date)
						tmp.append("Comment: " + commentObj.getElementsByTagName('body')[0].firstChild.data)
						tmp.append("\n")
						comments.append("\r\n".join(tmp))
					comments = "\r\n".join(comments)
				else:
					if comments != "":
						comments = "\r\n".join(comments)
				megaOutput.append([pair,case,documentName,document,transform,clashname,status,description,comments,distance,clashpoint,testName,group,clash_date,assignedto,approvedby,approvedDate,clashguid])
			except:
				continue
	return megaOutput
	
def getSurveyTransform(doc):
	basepoints = FilteredElementCollector(doc).OfClass(BasePoint)
	for basepoint in basepoints:
		if basepoint.IsShared:
			sv = basepoint
			break
	sv_transform = Transform.CreateTranslation(XYZ(0, 0, 0))
	cur_loc = projectPosition = doc.ActiveProjectLocation.GetProjectPosition(XYZ(0,0,0))
	rotation = Transform.CreateRotation(XYZ.BasisZ, projectPosition.Angle)
	cur_transform = Transform.CreateTranslation(XYZ(projectPosition.EastWest, projectPosition.NorthSouth, projectPosition.Elevation)).Multiply(rotation).Inverse
	final = sv_transform.Multiply(cur_transform)
	return final

def getGuids(doc):
	allIds = FilteredElementCollector(doc).WhereElementIsNotElementType().ToElementIds()
	allGuids = []
	for eachId in allIds:
		allGuids.append(str(ExportUtils.GetExportId(doc,eachId)))
	return [allGuids,allIds]

class FamOptions(IFamilyLoadOptions):
	def __init__(self):
		pass
	def OnFamilyFound(self,familyInUse, overwriteParameterValues):
		overwriteParameterValues.Value = False
		return True
	def OnSharedFamilyFound(self,familyInUse, source, overwriteParameterValues):
		overwriteParameterValues.Value = False
		return True

class KaramWarningIgnore(IFailuresPreprocessor):
	def PreprocessFailures(self, failuresAccessor):
		failuresAccessor.DeleteAllWarnings()
		return FailureProcessingResult.Continue

if int(DocumentManager.Instance.CurrentUIApplication.Application.VersionNumber) < 2021:
	ToInternalfactor = UnitUtils.ConvertToInternalUnits(1,doc.GetUnits().GetFormatOptions(UnitType.UT_Length).DisplayUnits)
	FromInternalfactor = UnitUtils.ConvertFromInternalUnits(1,doc.GetUnits().GetFormatOptions(UnitType.UT_Length).DisplayUnits)
else:
	ToInternalfactor = UnitUtils.ConvertToInternalUnits(1,doc.GetUnits().GetFormatOptions(SpecTypeId.Length).GetUnitTypeId())
	FromInternalfactor = UnitUtils.ConvertFromInternalUnits(1,doc.GetUnits().GetFormatOptions(SpecTypeId.Length).GetUnitTypeId())
	
linksIds = FilteredElementCollector(doc).OfClass(RevitLinkInstance).ToElementIds()
links = []
for linkId in linksIds:
	links.append(doc.GetElement(linkId))
	
levels = list(FilteredElementCollector(doc).OfClass(Level).ToElements())
levels.sort(key=lambda x: x.Elevation, reverse=False)

levelsData = []
for level in levels:
	levelsData.append([level.Name,level.Elevation])

linksData = []
for link in links:
	linkDoc = link.GetLinkDocument()
	if linkDoc != None:
		linkTitle = linkDoc.Title.Replace("_detached","") + ".rvt"
	else:
		continue
	linksData.append([link, linkDoc, linkTitle, link.GetTotalTransform(), getGuids(linkDoc)])

currentGuids = getGuids(doc)

cleanedLinksData = []
for linkData in linksData:
	if linkData[1] != None:
		cleanedLinksData.append(linkData)
linksData = cleanedLinksData

report = IN[0]
requestedfamilyname = IN[1]
mode = IN[2] # 1 is New Markers, 2 is New Views, 3 is Markers Cleanup, 4 is Views Cleanup, 5 is Cleanup All
cleanup = IN[3]
prefix = IN[4]
extra_bbox_distance = IN[5]
set3dGenerate = IN[6]
generateFixed = IN[7]
mark1param = IN[8]
mark2param = IN[9]
gen3dparam = IN[10]
isfixedparam = IN[11]
clashcategoryparam = IN[12]
clashlevelparam = IN[13]
clashvalueparam = IN[14]
idoneparam = IN[15]
idtwoparam = IN[16]
linkparam = IN[17]
sectionBoxparam = IN[18]
clashnameparam = IN[19]
clashstatusparam = IN[20]
clashdescriptionparam = IN[21]
clashcommentsparam = IN[22]
testnameparam = IN[23]
clashgroupparam = IN[24]
clashdateparam = IN[25]
assignedtoparam = IN[26]
approvedbyparam = IN[27]
approveddateparam = IN[28]
clashguidparam = IN[29]
tollerance = IN[30]*0.003280839895

cleanupAll = False
if mode == 5:
	cleanupAll = True

not_linked_string = "Not Linked"
not_existed_string = "Deleted Element"
link_not_loaded_string = "Link Not Loaded"
unknown_string = "Unknown"
error_string = "ERROR"
not_navis_string = "NOT_NAVISWORKS"
separator = "__"
andsym = " & "
error_message = "ERROR: Interference Parameters are Incorrect"
error_family_loading = "ERROR: Unable to Loading Interference Family: Please Contact Karam\n karam@aecedx.com"
error_family_not_found = "ERROR: Interference Family Not Found"
famname = "Sample-Interference Marker Family.rfa"

Dialogtitle = "AECedx - Karam"
msgs = []

checkfamily = [x for x in FilteredElementCollector(doc).OfClass(Family).ToElements() if requestedfamilyname.lower() == x.Name.lower()]
if len(checkfamily) == 0 and mode == 1:
	script = Dynamo.Applications.DynamoRevit().RevitDynamoModel.CurrentWorkspace.FileName.split("\\")[:-1]
	fullpath = "\\".join(script) + "\\" + famname
	if os.path.isfile(fullpath):
		TransactionManager.Instance.ForceCloseTransaction()
		trans = Transaction(doc, 'Load ' + requestedfamilyname)
		trans.Start()
		warnhandle = KaramWarningIgnore()
		foptions = trans.GetFailureHandlingOptions()
		foptions.SetFailuresPreprocessor(warnhandle)
		foptions.SetClearAfterRollback(True)
		trans.SetFailureHandlingOptions(foptions)
		loadedfamily = doc.LoadFamily(fullpath,FamOptions())[1]
		loadedfamily.Name = requestedfamilyname
		symbol = loadedfamily.GetFamilySymbolIds().GetEnumerator()
		symbol.MoveNext()
		symbol = doc.GetElement(symbol.Current)
		symbol.Name = requestedfamilyname
		if not symbol.IsActive: symbol.Activate()
		trans.Commit()
		familysymbol = symbol
	else:
		TaskDialog.Show(Dialogtitle, error_family_loading)
else:
	if len(checkfamily) == 0:
		TaskDialog.Show(Dialogtitle, error_family_not_found)
	else:
		symbol = checkfamily[0].GetFamilySymbolIds().GetEnumerator()
		symbol.MoveNext()
		symbol = doc.GetElement(symbol.Current)
		familysymbol = symbol

InterInstances = [x for x in FilteredElementCollector(doc).OfClass(FamilyInstance).ToElements() if familysymbol.FamilyName.lower() == x.Symbol.FamilyName.lower()]
InterInstancesIntegers = []
for InterInstance in InterInstances:
	InterInstancesIntegers.append(InterInstance.Id.IntegerValue)

stopIt = False
dumpedDataList = []
for InterInstance in InterInstances:
	dumpedData = []
	p_idone = paramGet(InterInstance,idoneparam)
	if p_idone != None:
		dumpedData.append(p_idone)
	else:
		stopIt = True
		break
	p_idtwo = paramGet(InterInstance,idtwoparam)
	if p_idtwo != None:
		dumpedData.append(p_idtwo)
	else:
		stopIt = True
		break
	p_linkname = paramGet(InterInstance,linkparam)
	if p_linkname != None:
		dumpedData.append(p_linkname)
	else:
		stopIt = True
		break
	p_clashlevel = paramGet(InterInstance,clashlevelparam)
	if p_clashlevel != None:
		dumpedData.append(p_clashlevel)
	else:
		stopIt = True
		break
	p_gen3d = paramGet(InterInstance,gen3dparam)
	if p_gen3d != None:
		dumpedData.append(p_gen3d)
	else:
		stopIt = True
		break
	p_isfixed = paramGet(InterInstance,isfixedparam)
	if p_isfixed != None:
		dumpedData.append(p_isfixed)
	else:
		stopIt = True
		break
	p_sectionBox = paramGet(InterInstance,sectionBoxparam)
	if p_sectionBox != None:
		dumpedData.append(p_sectionBox)
	else:
		stopIt = True
		break
	p_clashcat = paramGet(InterInstance,clashcategoryparam)
	if p_clashcat != None:
		dumpedData.append(p_clashcat)
	else:
		stopIt = True
		break
	if "None" in dumpedData:
		continue
	p_clashname = paramGet(InterInstance,clashnameparam)
	if p_clashname != None:
		dumpedData.append(p_clashname)
	else:
		stopIt = True
		break
	p_clashstatus = paramGet(InterInstance,clashstatusparam)
	if p_clashstatus != None:
		dumpedData.append(p_clashstatus)
	else:
		stopIt = True
		break
	p_clashdescription = paramGet(InterInstance,clashdescriptionparam)
	if p_clashdescription != None:
		dumpedData.append(p_clashdescription)
	else:
		stopIt = True
		break
	p_clashcomments = paramGet(InterInstance,clashcommentsparam)
	if p_clashcomments != None:
		dumpedData.append(p_clashcomments)
	else:
		stopIt = True
		break
	p_testname = paramGet(InterInstance,testnameparam)
	if p_testname != None:
		dumpedData.append(p_testname)
	else:
		stopIt = True
		break
	p_clashgroup = paramGet(InterInstance,clashgroupparam)
	if p_clashgroup != None:
		dumpedData.append(p_clashgroup)
	else:
		stopIt = True
		break
	p_clashdate = paramGet(InterInstance,clashdateparam)
	if p_clashdate != None:
		dumpedData.append(p_clashdate)
	else:
		stopIt = True
		break
	p_assignedto = paramGet(InterInstance,assignedtoparam)
	if p_assignedto != None:
		dumpedData.append(p_assignedto)
	else:
		stopIt = True
		break
	p_approvedby = paramGet(InterInstance,approvedbyparam)
	if p_approvedby != None:
		dumpedData.append(p_approvedby)
	else:
		stopIt = True
		break
	p_approveddate = paramGet(InterInstance,approveddateparam)
	if p_approveddate != None:
		dumpedData.append(p_approveddate)
	else:
		stopIt = True
		break
	p_clashguid = paramGet(InterInstance,clashguidparam)
	if p_clashguid != None:
		dumpedData.append(p_clashguid)
	else:
		stopIt = True
		break
	dumpedDataList.append([InterInstance,separator.join([dumpedData[0],dumpedData[1],dumpedData[2]]),dumpedData[0],dumpedData[1],dumpedData[2],dumpedData[3],dumpedData[4],dumpedData[5],dumpedData[6],dumpedData[7],dumpedData[8],dumpedData[9],dumpedData[10],dumpedData[11],dumpedData[12],dumpedData[13],dumpedData[14],dumpedData[15],dumpedData[16],dumpedData[17],dumpedData[18]])
		
if stopIt:
	msgs.append(error_message)
else:
	if mode == 1:
		if report.endswith(".html"):
			is_navis = False
			known_errors = {"  ", "td>  "}
			parser = ReportParser()
			with System.IO.File.OpenText(report) as f:
				while not f.EndOfStream:
					parser.feed(f.ReadLine().replace("&", ""))
			parser.data1.append(parser.temp_data)
			report_data = parser.data1[2:]
			parser.close()
		elif report.endswith(".xml"):
			if int(DocumentManager.Instance.CurrentUIApplication.Application.VersionNumber) < 2020:
				report_data = []
				msgs.append("Navisworks XML Supports Revit 2020 or Above")
			else:
				from xml.dom import minidom
				is_navis = True
				surveyTransform = getSurveyTransform(doc)
				title = getTitle(doc)
				report = minidom.parse(report)
				units = report.getElementsByTagName('exchange')[0].attributes['units'].value
				report_data = clashData(report,units,doc,title,andsym,linksData,link_not_loaded_string,not_linked_string,FromInternalfactor,surveyTransform,currentGuids,InterInstancesIntegers,not_existed_string,unknown_string)
		
		parser = None
		cases, elements, = [], []
		
		TransactionManager.Instance.ForceCloseTransaction()
		trans = Transaction(doc, 'K-Clash Markers Create')
		trans.Start()
		warnhandle = KaramWarningIgnore()
		foptions = trans.GetFailureHandlingOptions()
		foptions.SetFailuresPreprocessor(warnhandle)
		foptions.SetClearAfterRollback(True)
		trans.SetFailureHandlingOptions(foptions)
		
		stopIt = False

		found = []
		new = []
		
		for d in report_data:
			if is_navis:
				clash = d
				pair = clash[0]
				case = clash[1]
				documentName = clash[2]
				document = clash[3]
				transform = clash[4]
				clashName = clash[5]
				clashStatus = clash[6]
				clashDescription = clash[7]
				clashComments = clash[8]
				clashDistance = clash[9]
				clashPoint = clash[10]
				testName = clash[11]
				clashGroup = clash[12]
				clashDate = clash[13]
				assignedTo = clash[14]
				approvedBy = clash[15]
				approvedDate = clash[16]
				clashGUID = clash[17]
			else:
				clashName = not_navis_string
				clashStatus = not_navis_string
				clashDescription = not_navis_string
				clashComments = not_navis_string
				testName = not_navis_string
				clashGroup = not_navis_string
				clashDate = not_navis_string
				assignedTo = not_navis_string
				approvedBy = not_navis_string
				approvedDate = not_navis_string
				clashGUID = not_navis_string
				left, right = map(str.strip, d[1].split(" : ")), map(str.strip, d[2].split(" : "))
				leftId, rightId = int(filter(str.isdigit, left[-1])), int(filter(str.isdigit, right[-1]))
				if leftId in InterInstancesIntegers or rightId in InterInstancesIntegers:
					continue
				document = None
				if len(right) > 4:
					documentName = right[0]
					for linkData in linksData:
						if documentName.lower() == linkData[2].lower():
							document = linkData[1]
							transform = linkData[3]
							break
					if document == None:
						documentName = link_not_loaded_string
				else:
					documentName = not_linked_string
				leftId, rightId = getElement(False,leftId,None,not_linked_string), getElement(False,rightId,document,documentName)
				pair = (leftId, rightId)
				leftCat, rightCat = fetchCat(left), fetchCat(right)
				case = "%s%s%s" % (leftCat, andsym, rightCat) if leftCat is not None and rightCat is not None else "Unidentified"
			if not is_navis:
				if error_string not in pair and None not in pair:
					if hasattr(pair[0], 'WallType'):
						if (pair[0].WallType.Kind == WallKind.Curtain):
							continue
					if hasattr(pair[1], 'WallType'):
						if (pair[1].WallType.Kind == WallKind.Curtain):
							continue
					bbox1 = pair[0].get_BoundingBox(None).ToProtoType()
					bbox2 = pair[1].get_BoundingBox(None)
					if documentName == not_linked_string:
						bbox2 = bbox2.ToProtoType()
					else:
						bbox2min = transform.OfPoint(bbox2.Min).ToPoint()
						bbox2max = transform.OfPoint(bbox2.Max).ToPoint()
						bbox2 = dg.BoundingBox.ByCorners(bbox2min,bbox2max)
				else:
					continue
			if is_navis or dg.BoundingBox.Intersects(bbox1,bbox2):
				if is_navis:
					marker_loc = clashPoint
					marker_bbox_mid_height = marker_loc.Z * ToInternalfactor
					Viewbbox = dg.BoundingBox.ByCorners(dg.Point.ByCoordinates(marker_loc.X+(extra_bbox_distance/2),marker_loc.Y+(extra_bbox_distance/2),marker_loc.Z+(extra_bbox_distance/2)),dg.Point.ByCoordinates(marker_loc.X-(extra_bbox_distance/2),marker_loc.Y-(extra_bbox_distance/2),marker_loc.Z-(extra_bbox_distance/2)))
					marker_bboxValue = clashDistance
				else:
					marker_bbox = dg.BoundingBox.Intersection(bbox1,bbox2)
					marker_bboxOP = bboxValue(marker_bbox)
					marker_bboxValue = marker_bboxOP[0]
					marker_bboxVolume = marker_bboxOP[1]
					if marker_bboxValue == None or marker_bboxVolume == None:
						continue
					else:
						marker_bboxValue *= -ToInternalfactor
						marker_bboxVolume *= ToInternalfactor
						if marker_bboxVolume < tollerance:
							continue
					try:
						marker_bbox_mid = dg.Curve.PointAtParameter(dg.Line.ByStartPointEndPoint(marker_bbox.MaxPoint,marker_bbox.MinPoint),0.5)
						extended_line = dg.Curve.ExtendEnd(dg.Curve.ExtendStart(dg.Line.ByStartPointEndPoint(marker_bbox.MinPoint,marker_bbox.MaxPoint),extra_bbox_distance),extra_bbox_distance)
						Viewbbox = dg.BoundingBox.ByCorners(extended_line.StartPoint,extended_line.EndPoint)
					except:
						continue
					marker_line = dg.Line.ByStartPointEndPoint(Viewbbox.MinPoint,Viewbbox.MaxPoint)
					marker_loc = dg.Curve.PointAtParameter(dg.Line.ByStartPointEndPoint(Viewbbox.MinPoint,Viewbbox.MaxPoint),0.2)
					marker_bbox_mid_height = marker_bbox_mid.Z * ToInternalfactor
				validHeights = []
				for levelData in levelsData:
					if levelData[1] <= marker_bbox_mid_height:
						validHeights.append(levelData[1])
				if len(validHeights) == 0:
					validHeights = [levelsData[0][1]]
				closestHeight = take_closest(validHeights,marker_bbox_mid_height)
				for levelData in levelsData:
					if 	levelData[1] == closestHeight:
						levelName = levelData[0]
				
				if hasattr(pair[0], 'Id'):
					idone = pair[0].Id
				else:
					idone = pair[0]
					
				if hasattr(pair[1], 'Id'):
					idtwo = pair[1].Id
				else:
					idtwo = pair[1]
				
				if not is_navis:
					joinedCheck = separator.join([idone.ToString(),idtwo.ToString(),documentName])
					joinedCheck_inversed = separator.join([idtwo.ToString(),idone.ToString(),documentName])
				
				createNew = True
				for dumpedData in dumpedDataList:
					inversed = False
					if not is_navis and joinedCheck_inversed == dumpedData[1]:
						inversed = True
					if (is_navis and clashGUID == dumpedData[20]) or (not is_navis and (joinedCheck == dumpedData[1] or inversed)):
						createNew = False
						paramHandle(dumpedData[0],clashlevelparam,levelName)
						if clashStatus != not_navis_string:
							if (clashStatus == "New" or clashStatus == "Active" or clashStatus == "Reviewed") and idone != not_existed_string and idtwo != not_existed_string:
								paramHandle(dumpedData[0],isfixedparam,False)
							else:
								paramHandle(dumpedData[0],isfixedparam,True)
						maxP = Viewbbox.MaxPoint.ToXyz()
						minP = Viewbbox.MinPoint.ToXyz()
						MaxData = ",".join([str(maxP.X),str(maxP.Y),str(maxP.Z)])
						MinData = ",".join([str(minP.X),str(minP.Y),str(minP.Z)])
						marker_loc_xyz = marker_loc.ToXyz()
						marker_loc_data = ",".join([str(marker_loc_xyz.X),str(marker_loc_xyz.Y),str(marker_loc_xyz.Z)])
						paramHandle(dumpedData[0],sectionBoxparam,"|".join([MaxData,MinData,marker_loc_data]))
						paramHandle(dumpedData[0],clashvalueparam,marker_bboxValue)
						paramHandle(dumpedData[0],clashnameparam,clashName)
						paramHandle(dumpedData[0],clashstatusparam,clashStatus)
						paramHandle(dumpedData[0],clashdescriptionparam,clashDescription)
						paramHandle(dumpedData[0],clashcommentsparam,clashComments)
						paramHandle(dumpedData[0],testnameparam,testName)
						paramHandle(dumpedData[0],clashgroupparam,clashGroup)
						paramHandle(dumpedData[0],clashdateparam,clashDate)
						paramHandle(dumpedData[0],assignedtoparam,assignedTo)
						paramHandle(dumpedData[0],approvedbyparam,approvedBy)
						paramHandle(dumpedData[0],approveddateparam,approvedDate)
						
						if dumpedData[0].Location.Point.IsAlmostEqualTo(marker_loc_xyz) == False:
							if dumpedData[0].Pinned:
								dumpedData[0].Pinned = False
							dumpedData[0].Location.Point = marker_loc_xyz
							dumpedData[0].Pinned = True
						found.append(True)
						break
				
				if (createNew and not is_navis) or (createNew and is_navis and ((clashStatus == "New" or clashStatus == "Active" or clashStatus == "Reviewed") or ((clashStatus == "Resolved" or clashStatus == "Approved") and not cleanup)) and idone != not_existed_string and idtwo != not_existed_string):
					marker_loc_xyz = marker_loc.ToXyz()
					marker_loc_data = ",".join([str(marker_loc_xyz.X),str(marker_loc_xyz.Y),str(marker_loc_xyz.Z)])
					inter_family = doc.Create.NewFamilyInstance(marker_loc_xyz,familysymbol,Structure.StructuralType.NonStructural)
					inter_family.Pinned = True
					stopIt1 = paramHandle(inter_family,gen3dparam,set3dGenerate)
					stopIt2 = idparamHandle(inter_family,idoneparam,idone)
					stopIt3 = idparamHandle(inter_family,idtwoparam,idtwo)
					stopIt4 = paramHandle(inter_family,clashlevelparam,levelName)
					stopIt5 = paramHandle(inter_family,linkparam,documentName)
					if clashStatus == not_navis_string or clashStatus == "New" or clashStatus == "Active" or clashStatus == "Reviewed":
						stopIt6 = paramHandle(inter_family,isfixedparam,False)
					else:
						stopIt6 = paramHandle(inter_family,isfixedparam,True)
					maxP = Viewbbox.MaxPoint.ToXyz()
					minP = Viewbbox.MinPoint.ToXyz()
					MaxData = ",".join([str(maxP.X),str(maxP.Y),str(maxP.Z)])
					MinData = ",".join([str(minP.X),str(minP.Y),str(minP.Z)])
					stopIt7 = paramHandle(inter_family,sectionBoxparam,"|".join([MaxData,MinData,marker_loc_data]))
					stopit8 = paramHandle(inter_family,clashvalueparam,marker_bboxValue)
					stopit9 = paramHandle(inter_family,clashcategoryparam,case)
					stopit10 = paramHandle(inter_family,clashnameparam,clashName)
					stopit11 = paramHandle(inter_family,clashstatusparam,clashStatus)
					stopit12 = paramHandle(inter_family,clashdescriptionparam,clashDescription)
					stopit13 = paramHandle(inter_family,clashcommentsparam,clashComments)
					stopit14 = paramHandle(inter_family,testnameparam,testName)
					stopit15 = paramHandle(inter_family,clashgroupparam,clashGroup)
					stopit16 = paramHandle(inter_family,clashdateparam,clashDate)
					stopit17 = paramHandle(inter_family,assignedtoparam,assignedTo)
					stopit18 = paramHandle(inter_family,approvedbyparam,approvedBy)
					stopit19 = paramHandle(inter_family,approveddateparam,approvedDate)
					stopit20 = paramHandle(inter_family,clashguidparam,clashGUID)
					if stopIt1 or stopIt2 or stopIt3 or stopIt4 or stopIt5 or stopIt6 or stopIt7 or stopit8 or stopit9 or stopit10 or stopit11 or stopit12 or stopit13 or stopit14 or stopit15 or stopit16 or stopit17 or stopit18 or stopit19 or stopit20:
						stopIt = True
						doc.Delete(inter_family.Id)
						break
					new.append(True)
				
				elements.append(pair)
				cases.append(case)
		new = len(new)
		found = len(found)
		if new == 0 and found == 0:
			pass
		elif new > 0 and found == 0:
			msg = "Created " + str(new) + " Interference Markers"
			msgs.append(msg)
		elif found > 0 and new == 0:
			msg = "Found " + str(found) + " Interference Markers"
			msgs.append(msg)
		else:
			msg = "Created " + str(new) + " and Found " + str(found) + " Interference Markers"
			msgs.append(msg)
		trans.Commit()
		
	if (mode == 1 and cleanup) or mode == 3 or cleanupAll:
		TransactionManager.Instance.ForceCloseTransaction()
		trans = Transaction(doc, 'K-Clash Markers Cleanup')
		trans.Start()
		warnhandle = KaramWarningIgnore()
		foptions = trans.GetFailureHandlingOptions()
		foptions.SetFailuresPreprocessor(warnhandle)
		foptions.SetClearAfterRollback(True)
		trans.SetFailureHandlingOptions(foptions)
		
		deleted = []
		
		cleaned_dumpDataList = []
		for dumpedData in dumpedDataList:
			check1 = doc.GetElement(ElementId(int(dumpedData[2])))
			if check1 == None or dumpedData[0].LookupParameter(isfixedparam).AsInteger() == 1:
				doc.Delete(dumpedData[0].Id)
				deleted.append(True)
				continue
			if dumpedData[4] == not_linked_string:
				check2 = doc.GetElement(ElementId(int(dumpedData[3])))
				if check2 == None:
					doc.Delete(dumpedData[0].Id)
					deleted.append(True)
					continue
			else:
				document = None
				for linkData in linksData:
					if dumpedData[4] == linkData[2]:
						document = linkData[1]
						break
				if document == None and dumpedData[11] == not_navis_string:
					continue
				if document != None:
					check2 = document.GetElement(ElementId(int(dumpedData[3])))
				else:
					check2 = None
				if check2 == None and dumpedData[11] == not_navis_string:
					doc.Delete(dumpedData[0].Id)
					deleted.append(True)
					continue
			cleaned_dumpDataList.append(dumpedData)
		dumpedDataList = cleaned_dumpDataList
		
		deleted = len(deleted)
		if deleted > 0:
			msg = "Deleted " + str(deleted) + " Interference Markers"
			msgs.append(msg)
		
		trans.Commit()
		
	if mode == 2 or mode == 4 or cleanupAll:
		viewFamilyTypes = FilteredElementCollector(doc).OfClass(ViewFamilyType)
		for e in viewFamilyTypes:
			if str(e.ViewFamily) == "ThreeDimensional":
				viewType = e.Id
				break
		
		existedView3Ds = FilteredElementCollector(doc).OfClass(View3D)
		filteredViews3Ds = []
		existedView3DsNames = []
		for existedView3D in existedView3Ds:
			if existedView3D.IsTemplate == False:
				viewname = existedView3D.Name.split(separator)
				if len(viewname) > 2:
					existedView3DsNames.append(separator.join(viewname[-2:]))
					filteredViews3Ds.append(existedView3D)
		active_view_id = doc.ActiveView.Id
		
	if mode == 2:
		TransactionManager.Instance.ForceCloseTransaction()
		trans = Transaction(doc, 'K-Clash Views Create')
		trans.Start()
		warnhandle = KaramWarningIgnore()
		foptions = trans.GetFailureHandlingOptions()
		foptions.SetFailuresPreprocessor(warnhandle)
		foptions.SetClearAfterRollback(True)
		trans.SetFailureHandlingOptions(foptions)
		
		FillPats = FilteredElementCollector(doc).OfClass(FillPatternElement).ToElements()
		for FillPat in FillPats:
			if FillPat.GetFillPattern().IsSolidFill:
				break
		
		over_a = OverrideGraphicSettings().SetHalftone(True)
		over_b = OverrideGraphicSettings(over_a).SetSurfaceTransparency(90)
		
		color_a = OverrideGraphicSettings().SetCutForegroundPatternId(FillPat.Id)
		color_b = OverrideGraphicSettings(color_a).SetCutBackgroundPatternId(FillPat.Id)
		color_c = OverrideGraphicSettings(color_b).SetSurfaceForegroundPatternId(FillPat.Id)
		color_d = OverrideGraphicSettings(color_c).SetSurfaceBackgroundPatternId(FillPat.Id)
		
		color_yellow_a = OverrideGraphicSettings(color_d).SetCutBackgroundPatternColor(Color(255,255,0))
		color_yellow_b = OverrideGraphicSettings(color_yellow_a).SetCutForegroundPatternColor(Color(255,255,0))
		color_yellow_c = OverrideGraphicSettings(color_yellow_b).SetSurfaceForegroundPatternColor(Color(255,255,0))
		color_yellow_d = OverrideGraphicSettings(color_yellow_c).SetSurfaceBackgroundPatternColor(Color(255,255,0))
		
		color_green_a = OverrideGraphicSettings(color_d).SetCutBackgroundPatternColor(Color(0,128,0))
		color_green_b = OverrideGraphicSettings(color_green_a).SetCutForegroundPatternColor(Color(0,128,0))
		color_green_c = OverrideGraphicSettings(color_green_b).SetSurfaceForegroundPatternColor(Color(0,128,0))
		color_green_d = OverrideGraphicSettings(color_green_c).SetSurfaceBackgroundPatternColor(Color(0,128,0))
		
		level_cat = Category.GetCategory(doc,BuiltInCategory.OST_Levels)
		scope_cat = Category.GetCategory(doc,BuiltInCategory.OST_VolumeOfInterest)
		
		found = []
		new = []
		
		for dumpedData in dumpedDataList:
		
			if dumpedData[0].LookupParameter(gen3dparam).AsInteger() != 1:
				continue
				
			if generateFixed == False:
				if dumpedData[0].LookupParameter(isfixedparam).AsInteger() == 1:
					continue
			
			check1 = doc.GetElement(ElementId(int(dumpedData[2])))
			if check1 == None:
				continue
			
			if dumpedData[11] == not_navis_string:
				bbox1 = check1.get_BoundingBox(None).ToProtoType()
			else:
				bbox1 = None
			
			if dumpedData[4] == not_linked_string:
				check2 = doc.GetElement(ElementId(int(dumpedData[3])))
				if check2 == None:
					continue
				if dumpedData[11] == not_navis_string:
					bbox2 = check2.get_BoundingBox(None)
					bbox2 = bbox2.ToProtoType()
				else:
					bbox2 = None
			else:
				document = None
				for linkData in linksData:
					if dumpedData[4] == linkData[2]:
						myLink = linkData[0]
						document = linkData[1]
						transform = linkData[3]
						break
				if document == None and dumpedData[11] == not_navis_string:
					continue
				if document != None:
					check2 = document.GetElement(ElementId(int(dumpedData[3])))
				else:
					check2 = None
				if check2 == None and dumpedData[11] == not_navis_string:
					continue
				if dumpedData[11] == not_navis_string:
					bbox2 = check2.get_BoundingBox(None)
					bbox2min = transform.OfPoint(bbox2.Min).ToPoint()
					bbox2max = transform.OfPoint(bbox2.Max).ToPoint()
					bbox2 = dg.BoundingBox.ByCorners(bbox2min,bbox2max)
				else:
					bbox2 = None
			
			big_scope = False
			if dumpedData[11] == not_navis_string:
				if dg.BoundingBox.Intersects(bbox1,bbox2) == False:
					big_scope = True
				
			mark1param_val = markParamhandle(check1,mark1param)
			mark2param_val = markParamhandle(check2,mark2param)
			
			if mark1param_val == "" and mark2param_val == "":
				marks = ""
			elif mark1param_val == "" and mark2param_val != "":
				marks = mark2param_val.Replace(separator,"") + separator
			elif mark2param_val == "" and mark1param_val != "":
				marks = mark1param_val.Replace(separator,"") + separator
			else:
				marks = mark1param_val.Replace(separator,"") + andsym + mark2param_val.Replace(separator,"") + separator
			splitData = dumpedData[8].split("|")
			maxData = splitData[0].split(",")
			minData = splitData[1].split(",")
			marker_loc_data = splitData[2].split(",")
			if big_scope == False:
				maxP = XYZ(float(maxData[0]),float(maxData[1]),float(maxData[2]))
				minP = XYZ(float(minData[0]),float(minData[1]),float(minData[2]))
			marker_loc_xyz = XYZ(float(marker_loc_data[0]),float(marker_loc_data[1]),float(marker_loc_data[2]))
			if dumpedData[0].Location.Point.IsAlmostEqualTo(marker_loc_xyz) == False:
				dumpedData[0].Location.Point = marker_loc_xyz
			if dumpedData[0].Pinned == False:
				dumpedData[0].Pinned = True
			
			if big_scope == False:
				bbox = BoundingBoxXYZ()
				bbox.Max = maxP
				bbox.Min = minP
			else:
				bbox = dg.BoundingBox.ByGeometry([bbox1.MinPoint,bbox1.MaxPoint,bbox2.MinPoint,bbox2.MaxPoint]).ToRevitType()
			
			dumpedData[4] = dumpedData[4].replace(separator,"")
			
			compare_viewname = dumpedData[2].Replace(separator,"") + andsym + dumpedData[3].Replace(separator,"") + separator + dumpedData[4].Replace(separator,"")
			
			compare_viewname_inversed = dumpedData[3].Replace(separator,"") + andsym + dumpedData[2].Replace(separator,"") + separator + dumpedData[4].Replace(separator,"")
			
			exists = False
			inversed = False
			if compare_viewname in existedView3DsNames:
				view = filteredViews3Ds[existedView3DsNames.IndexOf(compare_viewname)]
				exists = True
			elif compare_viewname_inversed in existedView3DsNames:
				view = filteredViews3Ds[existedView3DsNames.IndexOf(compare_viewname_inversed)]
				exists = True
				inversed = True
			else:
				view = View3D.CreateIsometric(doc, viewType)
			
			if dumpedData[11] == "Approved":
				if dumpedData[18] == "None" or dumpedData[18] == "":
					ownerName = dumpedData[11].Replace(separator,"")
				else:
					ownerName = dumpedData[11].Replace(separator,"") + separator + dumpedData[18].Replace(separator,"")
			else:
				if dumpedData[17] == "None" or dumpedData[17] == "":
					ownerName = dumpedData[11]
				else:
					ownerName = dumpedData[11] + separator + dumpedData[17]
					
			if dumpedData[15] == "None" or dumpedData[15] == "":
				groupName = dumpedData[12].Replace(separator,"") + separator + dumpedData[14].Replace(separator,"")
			else:
				groupName = dumpedData[12].Replace(separator,"") + separator + dumpedData[14].Replace(separator,"") + separator + dumpedData[15].Replace(separator,"")
			
			if dumpedData[11] == not_navis_string:
				viewname = prefix.Replace(separator,"") + separator + "Hard" + separator + dumpedData[5].Replace(separator,"") + separator + marks + dumpedData[9].Replace(separator,"") + separator + compare_viewname
			else:
				viewname = prefix.Replace(separator,"") + separator + groupName + separator + ownerName + separator + dumpedData[10].Replace(separator,"") + separator + dumpedData[5].Replace(separator,"") + separator + marks + dumpedData[9].Replace(separator,"") + separator + compare_viewname
				
			if viewname != view.Name:
				try:
					view.Name = viewname
				except:
					if dumpedData[11] == not_navis_string:
						viewname = prefix.Replace(separator,"") + separator + "Hard" + separator + error_string + str(random.randrange(1, 1000)) + separator + dumpedData[5].Replace(separator,"") + separator + marks + dumpedData[9].Replace(separator,"") + separator + compare_viewname
					else:
						viewname = prefix.Replace(separator,"") + separator + groupName.Replace(separator,"") + separator + ownerName + separator + dumpedData[10].Replace(separator,"") + separator + error_string + str(random.randrange(1, 1000)) + separator + dumpedData[5].Replace(separator,"") + separator + marks + dumpedData[9].Replace(separator,"") + separator + compare_viewname
					view.Name = viewname
			
			if exists:
				found.append(True)
				if view.IsSectionBoxActive:
					existed_bbox = doc.GetElement(ElementId(view.Id.IntegerValue-1)).get_BoundingBox(view)
					existed_bbox_min = existed_bbox.Min
					existed_bbox_max = existed_bbox.Max
					if existed_bbox_min.IsAlmostEqualTo(bbox.Min) == False and existed_bbox_max.IsAlmostEqualTo(bbox.Max) == False:
						view.SetSectionBox(bbox)
						doc.Regenerate()
				else:
					view.SetSectionBox(bbox)
					doc.Regenerate()
			else:
				new.append(True)
				view.SetSectionBox(bbox)
			if view.CanCategoryBeHidden(level_cat.Id):
				view.SetCategoryHidden(level_cat.Id,True)
			if view.CanCategoryBeHidden(scope_cat.Id):
				view.SetCategoryHidden(scope_cat.Id,True)
			hideElems = List[ElementId]()
			for dumpedInside in dumpedDataList:
				if dumpedData[8] != dumpedInside[8]:
					hideElems.Add(dumpedInside[0].Id)
			if hideElems.Count != 0:
				view.HideElements(hideElems)
			if check2 != None:
				allElementsId = FilteredElementCollector(doc,view.Id).ToElementIds()
				allElementsId.Remove(check1.Id)
				if dumpedData[4] == not_linked_string:
					allElementsId.Remove(check2.Id)
					view.SetElementOverrides(check2.Id,color_green_d)
				else:
					allElementsId.Remove(myLink.Id)
				allElementsId.Remove(dumpedData[0].Id)
				for eachId in allElementsId:
					view.SetElementOverrides(eachId, over_b)
			view.SetElementOverrides(check1.Id,color_yellow_d)
		new = len(new)
		found = len(found)
		if new == 0 and found == 0:
			pass
		elif new > 0 and found == 0:
			msg = "Generated " + str(new) + " Views"
			msgs.append(msg)
		elif found > 0 and new == 0:
			msg = "Found " + str(found) + " Views"
			msgs.append(msg)
		else:
			msg = "Generated " + str(new) + " and Found " + str(found) + " Views"
			msgs.append(msg)
		trans.Commit()
		
	if (mode == 2 and cleanup) or mode == 4 or cleanupAll:
		TransactionManager.Instance.ForceCloseTransaction()
		trans = Transaction(doc, 'K-Clash Views Cleanup')
		trans.Start()
		warnhandle = KaramWarningIgnore()
		foptions = trans.GetFailureHandlingOptions()
		foptions.SetFailuresPreprocessor(warnhandle)
		foptions.SetClearAfterRollback(True)
		trans.SetFailureHandlingOptions(foptions)
		
		safe_views = []
		
		deleted = []
		
		for dumpedData in dumpedDataList:
			if dumpedData[0].LookupParameter(gen3dparam).AsInteger() == 0 or (generateFixed == False and dumpedData[0].LookupParameter(isfixedparam).AsInteger() == 1):
				continue
			compare_viewname = dumpedData[2].Replace(separator,"") + andsym + dumpedData[3].Replace(separator,"") + separator + dumpedData[4].Replace(separator,"")
			compare_viewname_inversed = dumpedData[3].Replace(separator,"") + andsym + dumpedData[2].Replace(separator,"") + separator + dumpedData[4].Replace(separator,"")
			if compare_viewname in existedView3DsNames:
				safe_views.append(compare_viewname)
			elif compare_viewname_inversed in existedView3DsNames: 
				safe_views.append(compare_viewname)
		non_safe_views = set(existedView3DsNames) - set(safe_views)
		
		for non_save_view in non_safe_views:
			views_indexes = [i for i in range(len(existedView3DsNames)) if existedView3DsNames[i] == non_save_view]
			for view_index in views_indexes:
				view_to_del_id = filteredViews3Ds[view_index].Id
				if active_view_id != view_to_del_id:
					doc.Delete(view_to_del_id)
					deleted.append(True)
				else:
					msgs.append("Unable to Delete Active View")
		
		deleted = len(deleted)
		if deleted > 0:
			msg = "Deleted " + str(deleted) + " Views"
			msgs.append(msg)

		trans.Commit()
		
	if stopIt:
		msgs.append(error_message)
		
if len(msgs) > 0:
	TaskDialog.Show(Dialogtitle, "\n".join(msgs))
OUT = "Done"
# ----------------------------------------
VARout = Output(python_script)
