# Dynamo custom node K-Join All In One.dyf (Dynamo 2.1.0.7500)
# category: Synthesize.Automate.Join
# K-Join All In One

VARCeilings = Input(VARCeilings: bool = true)
VARColumns = Input(VARColumns: bool = true)
VARFloors = Input(VARFloors: bool = true)
VARFloorsSlabEdges = Input(VARFloorsSlabEdges: bool = true)
VARGenericModels = Input(VARGenericModels: bool = true)
VARMass = Input(VARMass: bool = false)
VARRoofs = Input(VARRoofs: bool = true)
VARRoofsFascias = Input(VARRoofsFascias: bool = true)
VARRoofsGutters = Input(VARRoofsGutters: bool = true)
VARRoofSoffits = Input(VARRoofSoffits: bool = true)
VARStructuralColumns = Input(VARStructuralColumns: bool = true)
VARStructuralFoundations = Input(VARStructuralFoundations: bool = true)
VARStructuralFraming = Input(VARStructuralFraming: bool = true)
VARWalls = Input(VARWalls: bool = true)
VARWallSweeps = Input(VARWallSweeps: bool = true)
VARDetectionMode = Input(VARDetectionMode: double = 1)
python_script = Python(IN[0]=VARDetectionMode)
# ---------- python_script.python (21 lines) ----------
import clr
clr.AddReference('ProtoGeometry')
from Autodesk.DesignScript.Geometry import *
#The inputs to this node will be stored as a list in the IN variables.
dataEnteringNode = IN
input = IN[0]

if input == 1:
	active = True
	activefrom = False
elif input == 2:
	active = False
	activefrom = True
elif input == 3:
	active = False
	activefrom = False
else:
	active = True
	activefrom = False
#Assign your output to the OUT variable.
OUT = active, activefrom
# ----------------------------------------
code_block = CodeBlock(a=python_script) { a[0]; a[1]; }
VARIncludeWallsWithWalls = Input(VARIncludeWallsWithWalls: bool = false)
VARSwitchJoinOrderofAlreadyJoinedElement = Input(VARSwitchJoinOrderofAlreadyJoinedElements: bool = false)
VARConsiderVolumetricRuleForJoining = Input(VARConsiderVolumetricRuleForJoining: bool = true)
VARStartJoiningNewElements = Input(VARStartJoiningNewElements: bool = true)
VARSwitchJoinOrderForNewelyJoinedElement = Input(VARSwitchJoinOrderForNewelyJoinedElements: bool = false)
VARCleanUpAllTheJoiningWarnings = Input(VARCleanUpAllTheJoiningWarnings: bool = false)
VARStairs = Input(VARStairs: bool = true)
VARStairsSupports = Input(VARStairsSupports: bool = true)
VARUnjoinMode = Input(VARUnjoinMode: bool = false)
VARAvoidWarnings = Input(VARAvoidWarnings: bool = true)
python_script_2 = Python(IN[0]=VARCeilings, IN[1]=VARColumns, IN[2]=VARFloors, IN[3]=VARFloorsSlabEdges, IN[4]=VARGenericModels, IN[5]=VARMass, IN[6]=VARRoofs, IN[7]=VARRoofsFascias, IN[8]=VARRoofsGutters, IN[9]=VARRoofSoffits, IN[10]=VARStructuralColumns, IN[11]=VARStructuralFoundations, IN[12]=VARStructuralFraming, IN[13]=VARWalls, IN[14]=VARWallSweeps, IN[15]=code_block.out0, IN[16]=VARIncludeWallsWithWalls, IN[17]=VARSwitchJoinOrderofAlreadyJoinedElement, IN[18]=VARConsiderVolumetricRuleForJoining, IN[19]=VARStartJoiningNewElements, IN[20]=VARSwitchJoinOrderForNewelyJoinedElement, IN[21]=VARCleanUpAllTheJoiningWarnings, IN[22]=VARStairs, IN[23]=VARStairsSupports, IN[24]=code_block.out1, IN[25]=VARUnjoinMode, IN[26]=VARAvoidWarnings)
# ---------- python_script_2.python (546 lines) ----------
# Created By Karam Baki : karam@aecedx.com
# Enable Python support and load DesignScript library
# IMPORTANT : ALL DYNAMO DESIGN SCRIPT NODES ARE AS (dg)
import clr
import math
clr.AddReference('ProtoGeometry')
from Autodesk.DesignScript import Geometry as dg

# EXTENSION Enable ToDSType
clr.AddReference('RevitNodes')
import Revit
clr.ImportExtensions(Revit.Elements)

# Enable Revit Elements
from Revit.Elements import *

# EXTENSION Enable Geometry Conversion Methods
clr.ImportExtensions(Revit.GeometryConversion)

# Enable Revit API
clr.AddReference('RevitAPI')
from Autodesk.Revit.DB import *

# Enable DocumentManager and TransactionManager
clr.AddReference('RevitServices')
from RevitServices.Persistence import DocumentManager
from RevitServices.Transactions import TransactionManager

# Enable ICollection List Translate
clr.AddReference("System")
import System.Collections.Generic
from System.Collections.Generic import List
from itertools import compress
from itertools import combinations
#The inputs to this node will be stored as a list in the IN variables.

doc = DocumentManager.Instance.CurrentDBDocument
uidoc = DocumentManager.Instance.CurrentUIApplication.ActiveUIDocument
uiapp = DocumentManager.Instance.CurrentUIApplication
app = uiapp.Application

class WarnSwallowSimple(IFailuresPreprocessor):
	def PreprocessFailures(self, failuresAccessor):
		failuresAccessor.DeleteAllWarnings()
		return FailureProcessingResult.Continue

class WarnSwallow(IFailuresPreprocessor):
	def PreprocessFailures(self, failuresAccessor):
		fmas = failuresAccessor.GetFailureMessages()
		if len(fmas) == 0:
			self.__warn = []
			return FailureProcessingResult.Continue
		else:
			probs = []
			isgood = True
			for fma in fmas:
				sev = str(fma.GetSeverity())
				fails = list(fma.GetFailingElementIds())
				felems = []
				for f in fails:
					felems.append(doc.GetElement(f))
				if str(sev) == "Warning": 
					failuresAccessor.ResolveFailure(fma)
					failuresAccessor.DeleteWarning(fma)
				else:
					isgood = False
					probs.append(felems) 
				self.__warn = probs
		if isgood:
			return FailureProcessingResult.ProceedWithCommit
		else:
			return FailureProcessingResult.ProceedWithRollBack 

	@property
	def warn(self):
		return(self.__warn)

def joinop(trans,notjoined,unjoinmode = False,simple = False):
	if len(notjoined) > 0:
		trans.Start()
		if simple:
			warnhandle = WarnSwallowSimple()
		else:
			warnhandle = WarnSwallow()
		foptions = trans.GetFailureHandlingOptions()
		foptions.SetFailuresPreprocessor(warnhandle)
		if simple == False:
			foptions.SetClearAfterRollback(True)
		trans.SetFailureHandlingOptions(foptions)
		count = 0
		subtran = SubTransaction(doc)
		while (count < len(notjoined)):
			try:
				subtran.Start()
				if unjoinmode:
					JoinGeometryUtils.UnjoinGeometry(doc, notjoined[count][0], notjoined[count][1])
				else:
					JoinGeometryUtils.JoinGeometry(doc, notjoined[count][0], notjoined[count][1])
				if SwitchNewJoined == True:
					JoinGeometryUtils.SwitchJoinOrder(doc, notjoined[count][0], notjoined[count][1])
				count = count + 1
				subtran.Commit()
			except:
				subtran.RollBack()
				count = count +1
		trans.Commit()
		if simple == False:
			return warnhandle.warn
		else:
			return []
	else:
		return []

def removefrompairs(probs,notjoined):
	goodnotjoined = notjoined
	if len(probs) != 0:
		goodnotjoined = []
		notjoinedids = []
		for pair in notjoined:
			tmp = []
			for p in pair:
				tmp.append(p.Id)
			notjoinedids.append(tmp)
		problems = flatten(probs)
		dangerpairs = []
		for prob in problems:
			dangercount = 0
			for eachpair in notjoinedids:	
				if prob.Id in eachpair:
					dangerpairs.append(dangercount)
				dangercount += 1
		goodcount = 0
		for pair in notjoined:
			if goodcount not in dangerpairs:
				goodnotjoined.append(pair)
			goodcount += 1
	return goodnotjoined
	
def masterjoinop(trans,notjoined,unjoinmode = False,simple = False):
	probs = joinop(trans,notjoined,unjoinmode,simple)
	if simple == False:
		notjoined = removefrompairs(probs,notjoined)
		probs = joinop(trans,notjoined,unjoinmode)
		notjoined = removefrompairs(probs,notjoined)
		if len(notjoined) != 0:
			hosts = []
			probs = flatten(probs)
			for pro in probs:
				try:
					host = pro.GetHostIds()
					for h in host:
						hosts.append(doc.GetElement(h))
				except:
					pass
			notjoined = removefrompairs(hosts,notjoined)
			probs = joinop(trans,notjoined,unjoinmode)
			if len(probs) > 0:
				probids = []
				probs = flatten(probs)
				for p in probs:
					probids.append(str(p.Id))
				return probids
		else:
			return True
	else:
		return True

def flatten(x):
    result = []
    for el in x:
        if hasattr(el, "__iter__") and not isinstance(el, basestring):
            result.extend(flatten(el))
        else:
            result.append(el)
    return result
   
result=[]
Activeonly = IN[15]
AvtiveFromAll = IN[24]
unjoinmode = IN[25]
avoidwarnings = IN[26]

if avoidwarnings:
	simple = False
else:
	simple = True

if unjoinmode:
	simple = True

if AvtiveFromAll:
	Activeonly = False

if IN[0] == True:
	if Activeonly == True:
		result.append(FilteredElementCollector(doc,doc.ActiveView.Id).OfCategory(BuiltInCategory.OST_Ceilings).WhereElementIsNotElementType().ToElements())
	else:
		result.append(FilteredElementCollector(doc).OfCategory(BuiltInCategory.OST_Ceilings).WhereElementIsNotElementType().ToElements())
		
if IN[1] == True:
	if Activeonly == True:
		result.append(FilteredElementCollector(doc,doc.ActiveView.Id).OfCategory(BuiltInCategory.OST_Columns).WhereElementIsNotElementType().ToElements())
	else:
		result.append(FilteredElementCollector(doc).OfCategory(BuiltInCategory.OST_Columns).WhereElementIsNotElementType().ToElements())

if IN[2] == True:
	if Activeonly == True:
		result.append(FilteredElementCollector(doc,doc.ActiveView.Id).OfCategory(BuiltInCategory.OST_Floors).WhereElementIsNotElementType().ToElements())
	else:
		result.append(FilteredElementCollector(doc).OfCategory(BuiltInCategory.OST_Floors).WhereElementIsNotElementType().ToElements())

if IN[3] == True:
	if Activeonly == True:
		result.append(FilteredElementCollector(doc,doc.ActiveView.Id).OfCategory(BuiltInCategory.OST_EdgeSlab).WhereElementIsNotElementType().ToElements())
	else:
		result.append(FilteredElementCollector(doc).OfCategory(BuiltInCategory.OST_EdgeSlab).WhereElementIsNotElementType().ToElements())

if IN[4] == True:
	if Activeonly == True:
		result.append([x for x in FilteredElementCollector(doc,doc.ActiveView.Id).OfCategory(BuiltInCategory.OST_GenericModel).WhereElementIsNotElementType().ToElements() if hasattr(x, 'Symbol')])
	else:
		result.append([x for x in FilteredElementCollector(doc).OfCategory(BuiltInCategory.OST_GenericModel).WhereElementIsNotElementType().ToElements() if hasattr(x, 'Symbol')])

if IN[5] == True:
	if Activeonly == True:
		result.append(FilteredElementCollector(doc,doc.ActiveView.Id).OfCategory(BuiltInCategory.OST_Mass).WhereElementIsNotElementType().ToElements())
	else:
		result.append(FilteredElementCollector(doc).OfCategory(BuiltInCategory.OST_Mass).WhereElementIsNotElementType().ToElements())

if IN[6] == True:
	if Activeonly == True:
		result.append(FilteredElementCollector(doc,doc.ActiveView.Id).OfCategory(BuiltInCategory.OST_Roofs).WhereElementIsNotElementType().ToElements())
	else:
		result.append(FilteredElementCollector(doc).OfCategory(BuiltInCategory.OST_Roofs).WhereElementIsNotElementType().ToElements())

if IN[7] == True:
	if Activeonly == True:
		result.append(FilteredElementCollector(doc,doc.ActiveView.Id).OfCategory(BuiltInCategory.OST_Fascia).WhereElementIsNotElementType().ToElements())
	else:
		result.append(FilteredElementCollector(doc).OfCategory(BuiltInCategory.OST_Fascia).WhereElementIsNotElementType().ToElements())

if IN[8] == True:
	if Activeonly == True:
		result.append(FilteredElementCollector(doc,doc.ActiveView.Id).OfCategory(BuiltInCategory.OST_Gutter).WhereElementIsNotElementType().ToElements())
	else:
		result.append(FilteredElementCollector(doc).OfCategory(BuiltInCategory.OST_Gutter).WhereElementIsNotElementType().ToElements())

if IN[9] == True:
	if Activeonly == True:
		result.append(FilteredElementCollector(doc,doc.ActiveView.Id).OfCategory(BuiltInCategory.OST_RoofSoffit).WhereElementIsNotElementType().ToElements())
	else:
		result.append(FilteredElementCollector(doc).OfCategory(BuiltInCategory.OST_RoofSoffit).WhereElementIsNotElementType().ToElements())

if IN[10] == True:
	if Activeonly == True:
		result.append(FilteredElementCollector(doc,doc.ActiveView.Id).OfCategory(BuiltInCategory.OST_StructuralColumns).WhereElementIsNotElementType().ToElements())
	else:
		result.append(FilteredElementCollector(doc).OfCategory(BuiltInCategory.OST_StructuralColumns).WhereElementIsNotElementType().ToElements())

if IN[11] == True:
	if Activeonly == True:
		result.append(FilteredElementCollector(doc,doc.ActiveView.Id).OfCategory(BuiltInCategory.OST_StructuralFoundation).WhereElementIsNotElementType().ToElements())
	else:
		result.append(FilteredElementCollector(doc).OfCategory(BuiltInCategory.OST_StructuralFoundation).WhereElementIsNotElementType().ToElements())

if IN[12] == True:
	if Activeonly == True:
		result.append(FilteredElementCollector(doc,doc.ActiveView.Id).OfCategory(BuiltInCategory.OST_StructuralFraming).WhereElementIsNotElementType().ToElements())
	else:
		result.append(FilteredElementCollector(doc).OfCategory(BuiltInCategory.OST_StructuralFraming).WhereElementIsNotElementType().ToElements())

if IN[13] == True:
	if Activeonly == True:
		walls = FilteredElementCollector(doc,doc.ActiveView.Id).OfCategory(BuiltInCategory.OST_Walls).WhereElementIsNotElementType().ToElements()
		filteredwalls = [getattr(w, 'CurtainGrid', None) is None for w in walls]
		result.append(list(compress(walls, filteredwalls)))
	else:
		walls = FilteredElementCollector(doc).OfCategory(BuiltInCategory.OST_Walls).WhereElementIsNotElementType().ToElements()
		filteredwalls = [getattr(w, 'CurtainGrid', None) is None for w in walls]
		result.append(list(compress(walls, filteredwalls)))

if IN[14] == True:
	if Activeonly == True:
		result.append(FilteredElementCollector(doc,doc.ActiveView.Id).OfClass(WallSweep).WhereElementIsNotElementType().ToElements())
	else:
		result.append(FilteredElementCollector(doc).OfClass(WallSweep).WhereElementIsNotElementType().ToElements())

if IN[22] == True:
	if Activeonly == True:
		result.append(FilteredElementCollector(doc,doc.ActiveView.Id).OfCategory(BuiltInCategory.OST_Stairs).WhereElementIsNotElementType().ToElements())
	else:
		result.append(FilteredElementCollector(doc).OfCategory(BuiltInCategory.OST_Stairs).WhereElementIsNotElementType().ToElements())

if IN[23] == True:
	if Activeonly == True:
		stairs = list(FilteredElementCollector(doc,doc.ActiveView.Id).OfCategory(BuiltInCategory.OST_Stairs).WhereElementIsNotElementType().ToElements())
	else:
		stairs = list(FilteredElementCollector(doc).OfCategory(BuiltInCategory.OST_Stairs).WhereElementIsNotElementType().ToElements())
	supports = []
	for s in stairs:
		if hasattr(s, 'GetStairsSupports'):
			supportsid = s.GetStairsSupports()
			for sup in supportsid:		
				supports.append(doc.GetElement(sup))
		else:
			break
	result.append(flatten(supports))

elements = flatten(result)
allwalls = UnwrapElement(IN[16])
SwitchAlreadyJoined = UnwrapElement(IN[17])
ConsiderVolume = UnwrapElement(IN[18])
JoinNew = UnwrapElement(IN[19])
SwitchNewJoined = UnwrapElement(IN[20])
CleanUpAllWarn = UnwrapElement(IN[21])

if unjoinmode:
	ConsiderVolume = False
	SwitchAlreadyJoined = False
	SwitchNewJoined = False

bboxes = []
accept = []
for e in elements:
	try:
		bb = e.get_BoundingBox(None)
		bboxes.append(bb.ToProtoType())
		accept.append(True)
	except:
		accept.append(False)
		
acceptedelements = list(compress(elements, accept))

if AvtiveFromAll:
	visiblestuff = FilteredElementCollector(doc,doc.ActiveView.Id).ToElements()
	Vbboxes = []
	Vaccept = []
	for e in visiblestuff:
		try:
			bb = e.get_BoundingBox(None)
			Vbboxes.append(bb.ToProtoType())
			Vaccept.append(True)
		except:
			Vaccept.append(False)
			
	Vacceptedelements = list(compress(visiblestuff, Vaccept))
	
	tocombine = []
	tocombinebbox = []
	count = 0
	for v in Vacceptedelements:
		vb = Vbboxes[count]
		count += 1
		innercount = 0
		for a in acceptedelements:
			b =bboxes[innercount]
			innercount += 1
			tocombine.append([v,a])
			tocombinebbox.append([vb,b])
else:
	tocombineraw = combinations(acceptedelements,2)
	tocombinebboxraw = combinations(bboxes,2)
	
	comb = []
	for i in list(tocombineraw): 
	    comb.append(i)
	
	tocombine = comb
	
	comb2 = []
	for i in list(tocombinebboxraw): 
	    comb2.append(i)
	
	tocombinebbox = comb2

if allwalls == False:
	result = []
	allresult = []
	for eachlist in tocombine:
		tmplist = []
		for each in eachlist:
			if str(each.ToString()) == "Autodesk.Revit.DB.Wall":
				tmplist.append(True)
			else:
				tmplist.append(False)
		result.append(tmplist)

	for each in result:
		if all(each) == True:
			allresult.append(False)
		else:
			allresult.append(True)
	filtered = list(compress(tocombine, allresult))
	filteredbbox = list(compress(tocombinebbox, allresult))
else:
	filtered = tocombine
	filteredbbox = tocombinebbox

BBOX1 = [item[0] for item in filteredbbox]
BBOX2 = [item[1] for item in filteredbbox]

intersects = []

count = 0
for each in BBOX1:
	intersects.append(dg.BoundingBox.Intersects(each,BBOX2[count]))
	count = count + 1

count = 0
for each in BBOX1:
	each.Dispose()
	BBOX2[count].Dispose()
	count = count + 1

intersectingelements = list(compress(filtered, intersects))

##CHECK FOR JOINED ELEMENTS
listj = len(intersectingelements)
count = 0
arejoined = []
while (count < listj):
		result = JoinGeometryUtils.AreElementsJoined(doc, intersectingelements[count][0], intersectingelements[count][1])
		count = count + 1
		arejoined.append(result)

joined = list(compress(intersectingelements, arejoined))
if unjoinmode:
	notjoined = joined
else:
	notjoined =  list(compress(intersectingelements, [not i for i in arejoined]))

##GET EXISTED WARNINGS
if CleanUpAllWarn == False:
	wlist = doc.GetWarnings()
	wtext, welt, wsev = [], [], []
	for i in wlist:
		wtext.append(i.GetDescriptionText())
		welt.append(i.GetFailingElements())
		wsev.append(i.GetSeverity())

	existedwarn = []
	count = 0
	for each in wtext:
		if each == "Highlighted elements are joined but do not intersect.":
			existedwarn.append(welt[count])
		count = count + 1

TransactionManager.Instance.ForceCloseTransaction()
tGroup = TransactionGroup(doc, 'K-Join')
tGroup.Start()

trans1 = Transaction(doc, 'Switch Already Joined Elements')
if SwitchAlreadyJoined == True:
	trans1.Start()
	count = 0
	while (count < len(joined)):
		try:
			JoinGeometryUtils.SwitchJoinOrder(doc, joined[count][0], joined[count][1])
			count = count + 1
		except:
			count = count +1
	trans1.Commit()

##VOLUMENTRIC SORT
if ConsiderVolume == True:
	volumes = []
	for item in notjoined:
		tmplist = []
		for each in item:
			anothertmp = []
			for matid in each.GetMaterialIds(False):
				anothertmp.append(each.GetMaterialVolume(matid))
			tmplist.append(sum(anothertmp))
		volumes.append(tmplist)

	sortedunjoined = []

	count = 0
	for eachtwo in volumes:
		sortedunjoined.append([x for _,x in sorted(zip(eachtwo,notjoined[count]))])
		count = count + 1
	notjoined = sortedunjoined

if SwitchNewJoined == True:
	trans2 = Transaction(doc, 'K-Join And Switch New Elements')
else:
	trans2 = Transaction(doc, 'K-Join New Elements')
if JoinNew == True:
	masterjoinop(trans2,notjoined,unjoinmode,simple)

##Get New Warnings
wlist = doc.GetWarnings()
wtext, welt, wsev = [], [], []
for i in wlist:
	wtext.append(i.GetDescriptionText())
	welt.append(i.GetFailingElements())
	wsev.append(i.GetSeverity())

newwarn = []
count = 0
for each in wtext:
	if each == "Highlighted elements are joined but do not intersect.":
		newwarn.append(welt[count])
	count = count + 1

if CleanUpAllWarn == False:
	flattenexis = []
	for eachlist in existedwarn:
		flattenexis.append(str(eachlist[0]) + str(eachlist[1]))

	flattennew = []
	for eachlist in newwarn:
		flattennew.append(str(eachlist[0]) + str(eachlist[1]))
	
	onlynewwarns = set(flattennew) - set(flattenexis)

	ind = []
	for each in onlynewwarns:
		ind.append(flattennew.index(each))

	resultwarn = []
	for eachindex in ind:
		resultwarn.append(newwarn[eachindex])
else:
	resultwarn = newwarn

warntounjoin = []
for eachlist in resultwarn:
	tmplist = []
	for each in eachlist:
		tmplist.append(doc.GetElement(each))
	warntounjoin.append(tmplist)

trans3 = Transaction(doc, 'Clean Up Non-Intersected Elements')
trans3.Start()
count = 0
while (count < len(warntounjoin)):
	try:
		JoinGeometryUtils.UnjoinGeometry(doc, warntounjoin[count][0], warntounjoin[count][1])
		count = count + 1
	except:
		count = count +1
trans3.Commit()
tGroup.Assimilate()

OUT = "DONE"
# ----------------------------------------
VAROUT = Output(python_script_2)
