# Dynamo custom node K-Join Single List.dyf (Dynamo 2.1.0.7500)
# category: Synthesize.Automate.Join
# K-Join Single List

VARElements = Input(VARElements: var[]..[])
python_script = Python(IN[0]=VARElements)
# ---------- python_script.python (381 lines) ----------
# Created By Karam Baki : karam@aecedx.com
# Enable Python support and load DesignScript library
# IMPORTANT : ALL DYNAMO DESIGN SCRIPT NODES ARE AS (dg)
import clr
import math
clr.AddReference('ProtoGeometry')
from Autodesk.DesignScript import Geometry as dg

# EXTENSION Enable ToDSType
clr.AddReference('RevitNodes')
import Revit
clr.ImportExtensions(Revit.Elements)

# Enable Revit Elements
from Revit.Elements import *

# EXTENSION Enable Geometry Conversion Methods
clr.ImportExtensions(Revit.GeometryConversion)

# Enable Revit API
clr.AddReference('RevitAPI')
from Autodesk.Revit.DB import *

# Enable DocumentManager and TransactionManager
clr.AddReference('RevitServices')
from RevitServices.Persistence import DocumentManager
from RevitServices.Transactions import TransactionManager

# Enable ICollection List Translate
clr.AddReference("System")
import System.Collections.Generic
from System.Collections.Generic import List
from itertools import compress
from itertools import combinations
#The inputs to this node will be stored as a list in the IN variables.

doc = DocumentManager.Instance.CurrentDBDocument
uidoc = DocumentManager.Instance.CurrentUIApplication.ActiveUIDocument
uiapp = DocumentManager.Instance.CurrentUIApplication
app = uiapp.Application

class WarnSwallow(IFailuresPreprocessor):
	def PreprocessFailures(self, failuresAccessor):
		fmas = failuresAccessor.GetFailureMessages()
		if len(fmas) == 0:
			self.__warn = []
			return FailureProcessingResult.Continue
		else:
			probs = []
			isgood = True
			for fma in fmas:
				sev = str(fma.GetSeverity())
				fails = list(fma.GetFailingElementIds())
				felems = []
				for f in fails:
					felems.append(doc.GetElement(f))
				if str(sev) == "Warning": 
					failuresAccessor.ResolveFailure(fma)
					failuresAccessor.DeleteWarning(fma)
				else:
					isgood = False
					probs.append(felems) 
				self.__warn = probs
		if isgood:
			return FailureProcessingResult.ProceedWithCommit
		else:
			return FailureProcessingResult.ProceedWithRollBack 

	@property
	def warn(self):
		return(self.__warn)

def joinop(trans,notjoined,unjoinmode = False):
	if len(notjoined) > 0:
		trans.Start()
		warnhandle = WarnSwallow()
		foptions = trans.GetFailureHandlingOptions()
		foptions.SetFailuresPreprocessor(warnhandle)
		foptions.SetClearAfterRollback(True)
		trans.SetFailureHandlingOptions(foptions)
		count = 0
		subtran = SubTransaction(doc)
		while (count < len(notjoined)):
			try:
				subtran.Start()
				if unjoinmode:
					JoinGeometryUtils.UnjoinGeometry(doc, notjoined[count][0], notjoined[count][1])
				else:
					JoinGeometryUtils.JoinGeometry(doc, notjoined[count][0], notjoined[count][1])
				if SwitchNewJoined == True:
					JoinGeometryUtils.SwitchJoinOrder(doc, notjoined[count][0], notjoined[count][1])
				count = count + 1
				subtran.Commit()
			except:
				subtran.RollBack()
				count = count +1
		trans.Commit()
		return warnhandle.warn
	else:
		return []

def removefrompairs(probs,notjoined):
	goodnotjoined = notjoined
	if len(probs) != 0:
		goodnotjoined = []
		notjoinedids = []
		for pair in notjoined:
			tmp = []
			for p in pair:
				tmp.append(p.Id)
			notjoinedids.append(tmp)
		problems = flatten(probs)
		dangerpairs = []
		for prob in problems:
			dangercount = 0
			for eachpair in notjoinedids:	
				if prob.Id in eachpair:
					dangerpairs.append(dangercount)
				dangercount += 1
		goodcount = 0
		for pair in notjoined:
			if goodcount not in dangerpairs:
				goodnotjoined.append(pair)
			goodcount += 1
	return goodnotjoined
	
def masterjoinop(trans,notjoined,unjoinmode = False):
	probs = joinop(trans,notjoined,unjoinmode)
	notjoined = removefrompairs(probs,notjoined)
	probs = joinop(trans,notjoined,unjoinmode)
	notjoined = removefrompairs(probs,notjoined)
	if len(notjoined) != 0:
		hosts = []
		probs = flatten(probs)
		for pro in probs:
			try:
				host = pro.GetHostIds()
				for h in host:
					hosts.append(doc.GetElement(h))
			except:
				pass
		notjoined = removefrompairs(hosts,notjoined)
		probs = joinop(trans,notjoined,unjoinmode)
		if len(probs) > 0:
			probids = []
			probs = flatten(probs)
			for p in probs:
				probids.append(str(p.Id))
			problem = []
			problem.append("ERROR: Problems Found With Following Ids:")
			for r in probids:
				problem.append(r)
			return popup("\n".join(problem))
	else:
		return True

clr.AddReference("System.Windows.Forms")
from System.Windows.Forms import Form,Label
def popup(text):
	form = Form()
	form.Width = 600
	form.Height = 600
	label = Label()
	label.Text = text
	label.Width = 600
	label.Height = 600
	label.Parent = form	
	form.ShowDialog()

def flatten(x):
    result = []
    for el in x:
        if hasattr(el, "__iter__") and not isinstance(el, basestring):
            result.extend(flatten(el))
        else:
            result.append(el)
    return result

elements = UnwrapElement(IN[0])
allwalls = True
SwitchAlreadyJoined = False
ConsiderVolume = True
JoinNew = True
SwitchNewJoined = False
CleanUpAllWarn = False

bboxes = []
accept = []
for e in elements:
	try:
		bb = e.get_BoundingBox(None)
		bboxes.append(bb.ToProtoType())
		accept.append(True)
	except:
		accept.append(False)
		
acceptedelements = list(compress(elements, accept))

tocombineraw = combinations(acceptedelements,2)
tocombinebboxraw = combinations(bboxes,2)

comb = []
for i in list(tocombineraw): 
    comb.append(i)

tocombine = comb

comb2 = []
for i in list(tocombinebboxraw): 
    comb2.append(i)

tocombinebbox = comb2

if allwalls == False:
	result = []
	allresult = []
	for eachlist in tocombine:
		tmplist = []
		for each in eachlist:
			if str(each.ToString()) == "Autodesk.Revit.DB.Wall":
				tmplist.append(True)
			else:
				tmplist.append(False)
		result.append(tmplist)

	for each in result:
		if all(each) == True:
			allresult.append(False)
		else:
			allresult.append(True)
	filtered = list(compress(tocombine, allresult))
	filteredbbox = list(compress(tocombinebbox, allresult))
else:
	filtered = tocombine
	filteredbbox = tocombinebbox

BBOX1 = [item[0] for item in filteredbbox]
BBOX2 = [item[1] for item in filteredbbox]

intersects = []

count = 0
for each in BBOX1:
	intersects.append(dg.BoundingBox.Intersects(each,BBOX2[count]))
	count = count + 1

count = 0
for each in BBOX1:
	each.Dispose()
	BBOX2[count].Dispose()
	count = count + 1

intersectingelements = list(compress(filtered, intersects))

##CHECK FOR JOINED ELEMENTS
listj = len(intersectingelements)
count = 0
arejoined = []
while (count < listj):
		result = JoinGeometryUtils.AreElementsJoined(doc, intersectingelements[count][0], intersectingelements[count][1])
		count = count + 1
		arejoined.append(result)

joined = list(compress(intersectingelements, arejoined))
notjoined =  list(compress(intersectingelements, [not i for i in arejoined]))

##GET EXISTED WARNINGS
if CleanUpAllWarn == False:
	wlist = doc.GetWarnings()
	wtext, welt, wsev = [], [], []
	for i in wlist:
		wtext.append(i.GetDescriptionText())
		welt.append(i.GetFailingElements())
		wsev.append(i.GetSeverity())

	existedwarn = []
	count = 0
	for each in wtext:
		if each == "Highlighted elements are joined but do not intersect.":
			existedwarn.append(welt[count])
		count = count + 1

TransactionManager.Instance.ForceCloseTransaction()
tGroup = TransactionGroup(doc, 'K-Join')
tGroup.Start()

trans1 = Transaction(doc, 'Switch Already Joined Elements')
if SwitchAlreadyJoined == True:
	trans1.Start()
	count = 0
	while (count < len(joined)):
		try:
			JoinGeometryUtils.SwitchJoinOrder(doc, joined[count][0], joined[count][1])
			count = count + 1
		except:
			count = count +1
	trans1.Commit()

##VOLUMENTRIC SORT
if ConsiderVolume == True:
	volumes = []
	for item in notjoined:
		tmplist = []
		for each in item:
			anothertmp = []
			for matid in each.GetMaterialIds(False):
				anothertmp.append(each.GetMaterialVolume(matid))
			tmplist.append(sum(anothertmp))
		volumes.append(tmplist)

	sortedunjoined = []

	count = 0
	for eachtwo in volumes:
		sortedunjoined.append([x for _,x in sorted(zip(eachtwo,notjoined[count]))])
		count = count + 1
	notjoined = sortedunjoined

if SwitchNewJoined == True:
	trans2 = Transaction(doc, 'K-Join And Switch New Elements')
else:
	trans2 = Transaction(doc, 'K-Join New Elements')
if JoinNew == True:
	masterjoinop(trans2,notjoined)

##Get New Warnings
wlist = doc.GetWarnings()
wtext, welt, wsev = [], [], []
for i in wlist:
	wtext.append(i.GetDescriptionText())
	welt.append(i.GetFailingElements())
	wsev.append(i.GetSeverity())

newwarn = []
count = 0
for each in wtext:
	if each == "Highlighted elements are joined but do not intersect.":
		newwarn.append(welt[count])
	count = count + 1

if CleanUpAllWarn == False:
	flattenexis = []
	for eachlist in existedwarn:
		flattenexis.append(str(eachlist[0]) + str(eachlist[1]))

	flattennew = []
	for eachlist in newwarn:
		flattennew.append(str(eachlist[0]) + str(eachlist[1]))
	
	onlynewwarns = set(flattennew) - set(flattenexis)

	ind = []
	for each in onlynewwarns:
		ind.append(flattennew.index(each))

	resultwarn = []
	for eachindex in ind:
		resultwarn.append(newwarn[eachindex])
else:
	resultwarn = newwarn

warntounjoin = []
for eachlist in resultwarn:
	tmplist = []
	for each in eachlist:
		tmplist.append(doc.GetElement(each))
	warntounjoin.append(tmplist)

trans3 = Transaction(doc, 'Clean Up Non-Intersected Elements')
trans3.Start()
count = 0
while (count < len(warntounjoin)):
	try:
		JoinGeometryUtils.UnjoinGeometry(doc, warntounjoin[count][0], warntounjoin[count][1])
		count = count + 1
	except:
		count = count +1
trans3.Commit()
tGroup.Assimilate()

OUT = "DONE"
# ----------------------------------------
VAROut = Output(python_script)
