# Dynamo custom node K-Join Two Categories.dyf (Dynamo 2.1.0.7500)
# category: Synthesize.Automate.Join
# K-Join Two Categories

VARSwitchJoinOrderofAlreadyJoinedElement = Input(VARSwitchJoinOrderofAlreadyJoinedElements: bool = false)
VARConsiderVolumetricRuleForJoining = Input(VARConsiderVolumetricRuleForJoining: bool = true)
VARStartJoiningNewElements = Input(VARStartJoiningNewElements: bool = true)
VARSwitchJoinOrderForNewelyJoinedElement = Input(VARSwitchJoinOrderForNewelyJoinedElements: bool = false)
VARCleanUpAllTheJoiningWarnings = Input(VARCleanUpAllTheJoiningWarnings: bool = false)
VARCutMode = Input(VARCutMode: bool = false)
VARUnjoinMode = Input(VARUnjoinMode: bool = false)
VARAvoidWarnings = Input(VARAvoidWarnings: bool = false)
VARIncludeWallsWithWalls = Input(VARIncludeWallsWithWalls: bool = false)
VARActiveViewOnly = Input(VARActiveViewOnly: bool = false)
VARCategory1 = Input(VARCategory1: var = Revit.Elements.Category.ByName("OST_Walls"))
VARCategory2 = Input(VARCategory2: var = Revit.Elements.Category.ByName("OST_Floors"))
python_script = Python(IN[0]=VARSwitchJoinOrderofAlreadyJoinedElement, IN[1]=VARConsiderVolumetricRuleForJoining, IN[2]=VARStartJoiningNewElements, IN[3]=VARSwitchJoinOrderForNewelyJoinedElement, IN[4]=VARCleanUpAllTheJoiningWarnings, IN[5]=VARCutMode, IN[6]=VARUnjoinMode, IN[7]=VARAvoidWarnings, IN[8]=VARIncludeWallsWithWalls, IN[9]=VARActiveViewOnly, IN[10]=VARCategory1, IN[11]=VARCategory2)
# ---------- python_script.python (456 lines) ----------
# Created By Karam Baki : karam@aecedx.com

# Enable Python support and load DesignScript library
# IMPORTANT : ALL DYNAMO DESIGN SCRIPT NODES ARE AS (dg)
import clr
import math
clr.AddReference('ProtoGeometry')
from Autodesk.DesignScript import Geometry as dg

# EXTENSION Enable ToDSType
clr.AddReference('RevitNodes')
import Revit
clr.ImportExtensions(Revit.Elements)

import System

# Enable Revit Elements
from Revit.Elements import *

# EXTENSION Enable Geometry Conversion Methods
clr.ImportExtensions(Revit.GeometryConversion)

# Enable Revit API
clr.AddReference('RevitAPI')
from Autodesk.Revit.DB import *

# Enable DocumentManager and TransactionManager
clr.AddReference('RevitServices')
from RevitServices.Persistence import DocumentManager
from RevitServices.Transactions import TransactionManager

# Enable ICollection List Translate
clr.AddReference("System")
import System.Collections.Generic
from System.Collections.Generic import List
from itertools import compress
from itertools import combinations

doc = DocumentManager.Instance.CurrentDBDocument
uidoc = DocumentManager.Instance.CurrentUIApplication.ActiveUIDocument
uiapp = DocumentManager.Instance.CurrentUIApplication
app = uiapp.Application

class WarnSwallowSimple(IFailuresPreprocessor):
	def PreprocessFailures(self, failuresAccessor):
		failuresAccessor.DeleteAllWarnings()
		return FailureProcessingResult.Continue

class WarnSwallow(IFailuresPreprocessor):
	def PreprocessFailures(self, failuresAccessor):
		fmas = failuresAccessor.GetFailureMessages()
		if len(fmas) == 0:
			self.__warn = []
			return FailureProcessingResult.Continue
		else:
			probs = []
			isgood = True
			for fma in fmas:
				sev = str(fma.GetSeverity())
				fails = list(fma.GetFailingElementIds())
				felems = []
				for f in fails:
					felems.append(doc.GetElement(f))
				if str(sev) == "Warning": 
					failuresAccessor.ResolveFailure(fma)
					failuresAccessor.DeleteWarning(fma)
				else:
					isgood = False
					probs.append(felems) 
				self.__warn = probs
		if isgood:
			return FailureProcessingResult.ProceedWithCommit
		else:
			return FailureProcessingResult.ProceedWithRollBack 

	@property
	def warn(self):
		return(self.__warn)

def getostcat(catname):
	bic = System.Enum.GetValues(BuiltInCategory) 
	cats, bics = [], []
	for i in bic:
	    try:
	        cat = Revit.Elements.Category.ById(ElementId(i).IntegerValue)
	        cats.append(cat)
	        bics.append(i)
	    except:
	        pass
	 
	for i, b in zip(cats, bics):
	    if catname == str(i): 
	        ost = b
	return ost

def joinop(trans,notjoined,unjoinmode = False,simple = False):
	if len(notjoined) > 0:
		trans.Start()
		if simple:
			warnhandle = WarnSwallowSimple()
		else:
			warnhandle = WarnSwallow()
		foptions = trans.GetFailureHandlingOptions()
		foptions.SetFailuresPreprocessor(warnhandle)
		if simple == False:
			foptions.SetClearAfterRollback(True)
		trans.SetFailureHandlingOptions(foptions)
		count = 0
		subtran = SubTransaction(doc)
		while (count < len(notjoined)):
			try:
				subtran.Start()
				if unjoinmode:
					JoinGeometryUtils.UnjoinGeometry(doc, notjoined[count][0], notjoined[count][1])
				else:
					if cutelems == False:
						JoinGeometryUtils.JoinGeometry(doc, notjoined[count][0], notjoined[count][1])
						if SwitchNewJoined == True:
							JoinGeometryUtils.SwitchJoinOrder(doc, notjoined[count][0], notjoined[count][1])
					else:
						if SwitchNewJoined == True:
							notjoined[count].reverse()
						try:
							InstanceVoidCutUtils.AddInstanceVoidCut(doc, notjoined[count][0], notjoined[count][1])
						except:
							try:
								SolidSolidCutUtils.AddCutBetweenSolids(doc, notjoined[count][0], notjoined[count][1], False)
							except:
								pass
				count = count + 1
				subtran.Commit()
			except:
				subtran.RollBack()
				count = count +1
		trans.Commit()
		if simple == False:
			return warnhandle.warn
		else:
			return []
	else:
		return []

def removefrompairs(probs,notjoined):
	goodnotjoined = notjoined
	if len(probs) != 0:
		goodnotjoined = []
		notjoinedids = []
		for pair in notjoined:
			tmp = []
			for p in pair:
				tmp.append(p.Id)
			notjoinedids.append(tmp)
		problems = flatten(probs)
		dangerpairs = []
		for prob in problems:
			dangercount = 0
			for eachpair in notjoinedids:	
				if prob.Id in eachpair:
					dangerpairs.append(dangercount)
				dangercount += 1
		goodcount = 0
		for pair in notjoined:
			if goodcount not in dangerpairs:
				goodnotjoined.append(pair)
			goodcount += 1
	return goodnotjoined
	
def masterjoinop(trans,notjoined,unjoinmode = False,simple = False):
	probs = joinop(trans,notjoined,unjoinmode,simple)
	if simple == False:
		notjoined = removefrompairs(probs,notjoined)
		probs = joinop(trans,notjoined,unjoinmode)
		notjoined = removefrompairs(probs,notjoined)
		if len(notjoined) != 0:
			hosts = []
			probs = flatten(probs)
			for pro in probs:
				try:
					host = pro.GetHostIds()
					for h in host:
						hosts.append(doc.GetElement(h))
				except:
					pass
			notjoined = removefrompairs(hosts,notjoined)
			probs = joinop(trans,notjoined,unjoinmode)
			if len(probs) > 0:
				probids = []
				probs = flatten(probs)
				for p in probs:
					probids.append(str(p.Id))
				return probids
		else:
			return True
	else:
		return True

def flatten(x):
    result = []
    for el in x:
        if hasattr(el, "__iter__") and not isinstance(el, basestring):
            result.extend(flatten(el))
        else:
            result.append(el)
    return result

SwitchAlreadyJoined = UnwrapElement(IN[0])
ConsiderVolume = UnwrapElement(IN[1])
JoinNew = UnwrapElement(IN[2])
SwitchNewJoined = UnwrapElement(IN[3])
CleanUpAllWarn = UnwrapElement(IN[4])
cutelems = IN[5]
unjoinmode = IN[6]
avoidwarnings = IN[7]
allwalls = IN[8]
Activeonly = IN[9]
category1 = getostcat(IN[10].Name)
category2 = getostcat(IN[11].Name)

if avoidwarnings:
	simple = False
else:
	simple = True

if unjoinmode:
	simple = True

elements = []

if IN[10].Name != "Generic Models":
	if Activeonly == True:
		elements.append(FilteredElementCollector(doc,doc.ActiveView.Id).OfCategory(category1).WhereElementIsNotElementType().ToElements())
	else:
		elements.append(FilteredElementCollector(doc).OfCategory(category1).WhereElementIsNotElementType().ToElements())
else:
	if Activeonly == True:
		elements.append([x for x in FilteredElementCollector(doc,doc.ActiveView.Id).OfCategory(category1).WhereElementIsNotElementType().ToElements() if hasattr(x, 'Symbol')])
	else:
		elements.append([x for x in FilteredElementCollector(doc).OfCategory(category1).WhereElementIsNotElementType().ToElements() if hasattr(x, 'Symbol')])
	

if IN[11].Name != "Generic Models":
	if Activeonly == True:
		elements.append(FilteredElementCollector(doc,doc.ActiveView.Id).OfCategory(category2).WhereElementIsNotElementType().ToElements())
	else:
		elements.append(FilteredElementCollector(doc).OfCategory(category2).WhereElementIsNotElementType().ToElements())
else:
	if Activeonly == True:
		elements.append([x for x in FilteredElementCollector(doc,doc.ActiveView.Id).OfCategory(category2).WhereElementIsNotElementType().ToElements() if hasattr(x, 'Symbol')])
	else:
		elements.append([x for x in FilteredElementCollector(doc).OfCategory(category2).WhereElementIsNotElementType().ToElements() if hasattr(x, 'Symbol')])

elements = flatten(elements)

bboxes = []
accept = []
for e in elements:
	try:
		bb = e.get_BoundingBox(None)
		bboxes.append(bb.ToProtoType())
		accept.append(True)
	except:
		accept.append(False)
		
acceptedelements = list(compress(elements, accept))

tocombineraw = combinations(acceptedelements,2)
tocombinebboxraw = combinations(bboxes,2)
	
comb = []
for i in list(tocombineraw): 
    comb.append(i)	
tocombine = comb
	
comb2 = []
for i in list(tocombinebboxraw): 
    comb2.append(i)
tocombinebbox = comb2

if allwalls == False:
	result = []
	allresult = []
	for eachlist in tocombine:
		tmplist = []
		for each in eachlist:
			if str(each.ToString()) == "Autodesk.Revit.DB.Wall":
				tmplist.append(True)
			else:
				tmplist.append(False)
		result.append(tmplist)

	for each in result:
		if all(each) == True:
			allresult.append(False)
		else:
			allresult.append(True)
	filtered = list(compress(tocombine, allresult))
	filteredbbox = list(compress(tocombinebbox, allresult))
else:
	filtered = tocombine
	filteredbbox = tocombinebbox

BBOX1 = [item[0] for item in filteredbbox]
BBOX2 = [item[1] for item in filteredbbox]

intersects = []

count = 0
for each in BBOX1:
	intersects.append(dg.BoundingBox.Intersects(each,BBOX2[count]))
	count = count + 1

count = 0
for each in BBOX1:
	each.Dispose()
	BBOX2[count].Dispose()
	count = count + 1

intersectingelements = list(compress(filtered, intersects))

##CHECK FOR JOINED ELEMENTS
listj = len(intersectingelements)
count = 0
arejoined = []
while (count < listj):
		if unjoinmode == False:
			result = JoinGeometryUtils.AreElementsJoined(doc, intersectingelements[count][0], intersectingelements[count][1])
		else:
			result = False
		count = count + 1
		arejoined.append(result)

joined = list(compress(intersectingelements, arejoined))
notjoined =  list(compress(intersectingelements, [not i for i in arejoined]))

##GET EXISTED WARNINGS
if CleanUpAllWarn == False and cutelems == False:
	wlist = doc.GetWarnings()
	wtext, welt, wsev = [], [], []
	for i in wlist:
		wtext.append(i.GetDescriptionText())
		welt.append(i.GetFailingElements())
		wsev.append(i.GetSeverity())

	existedwarn = []
	count = 0
	for each in wtext:
		if each == "Highlighted elements are joined but do not intersect.":
			existedwarn.append(welt[count])
		count = count + 1

TransactionManager.Instance.ForceCloseTransaction()
tGroup = TransactionGroup(doc, 'K-Join')
tGroup.Start()

trans1 = Transaction(doc, 'Switch Already Joined Elements')
if SwitchAlreadyJoined == True and cutelems == False:
	trans1.Start()
	count = 0
	while (count < len(joined)):
		try:
			JoinGeometryUtils.SwitchJoinOrder(doc, joined[count][0], joined[count][1])
			count = count + 1
		except:
			count = count +1
	trans1.Commit()

##VOLUMENTRIC SORT
if ConsiderVolume == True:
	volumes = []
	for item in notjoined:
		tmplist = []
		for each in item:
			anothertmp = []
			for matid in each.GetMaterialIds(False):
				anothertmp.append(each.GetMaterialVolume(matid))
			tmplist.append(sum(anothertmp))
		volumes.append(tmplist)

	sortedunjoined = []

	count = 0
	for eachtwo in volumes:
		sortedunjoined.append([x for _,x in sorted(zip(eachtwo,notjoined[count]))])
		count = count + 1
	notjoined = sortedunjoined

if SwitchNewJoined == True and cutelems == False:
	trans2 = Transaction(doc, 'K-Join And Switch New Elements')
else:
	if unjoinmode:
		trans2 = Transaction(doc, 'K-Join Unjoin Elements')
	else:
		if cutelems == False:
			trans2 = Transaction(doc, 'K-Join New Elements')
		else:
			trans2 = Transaction(doc, 'K-Cut Elements')
if JoinNew == True or cutelems == True or unjoinmode:
	masterjoinop(trans2,notjoined,unjoinmode,simple)

if cutelems == False:
	##Get New Warnings
	wlist = doc.GetWarnings()
	wtext, welt, wsev = [], [], []
	for i in wlist:
		wtext.append(i.GetDescriptionText())
		welt.append(i.GetFailingElements())
		wsev.append(i.GetSeverity())
	
	newwarn = []
	count = 0
	for each in wtext:
		if each == "Highlighted elements are joined but do not intersect.":
			newwarn.append(welt[count])
		count = count + 1
	
	if CleanUpAllWarn == False:
		flattenexis = []
		for eachlist in existedwarn:
			flattenexis.append(str(eachlist[0]) + str(eachlist[1]))
	
		flattennew = []
		for eachlist in newwarn:
			flattennew.append(str(eachlist[0]) + str(eachlist[1]))
		
		onlynewwarns = set(flattennew) - set(flattenexis)
	
		ind = []
		for each in onlynewwarns:
			ind.append(flattennew.index(each))
	
		resultwarn = []
		for eachindex in ind:
			resultwarn.append(newwarn[eachindex])
	else:
		resultwarn = newwarn
	
	warntounjoin = []
	for eachlist in resultwarn:
		tmplist = []
		for each in eachlist:
			tmplist.append(doc.GetElement(each))
		warntounjoin.append(tmplist)
	
	trans3 = Transaction(doc, 'Clean Up Non-Intersected Elements')
	trans3.Start()
	count = 0
	while (count < len(warntounjoin)):
		try:
			JoinGeometryUtils.UnjoinGeometry(doc, warntounjoin[count][0], warntounjoin[count][1])
			count = count + 1
		except:
			count = count +1
	trans3.Commit()
tGroup.Assimilate()

OUT = "DONE"
# ----------------------------------------
VAROut = Output(python_script)
