# Dynamo custom node K-Paneling Data Export.dyf (Dynamo 2.1.0.7500)
# category: Synthesize.Automate.Family
# K-Paneling Data Export

VARSurfaces = Input(VARSurfaces: var[]..[])
serializeAsSAB = Geometry.SerializeAsSAB(geometry=VARSurfaces)
VARBorderDepth = Input(VARBorderDepth: double = 0.2)
VARBorderWidth = Input(VARBorderWidth: double = 0.1)
VARDistanceU = Input(VARDistanceU: double[])
python_empty_2_null = Custom[Python Empty 2 Null](VARIN=VARDistanceU)  # Python Null 2 Empty
VARDistanaceV = Input(VARDistanaceV: double[])
python_empty_2_null_2 = Custom[Python Empty 2 Null](VARIN=VARDistanaceV)
VARMethodU = Input(VARMethodU: bool = false)
VARMethodV = Input(VARMethodV: bool = false)
VARUWidth = Input(VARUWidth: double = 0.2)
VARUDepth = Input(VARUDepth: double = 0.15)
VARVWidth = Input(VARVWidth: double = 0.2)
VARVDepth = Input(VARVDepth: double = 0.2)
VARExtendFix = Input(VARExtendFix: double = 3.3)
VARPrecision = Input(VARPrecision: double = 1.15)
VARPanelThickness = Input(VARPanelThickness: double = 0.03)
VARCreatePanels = Input(VARCreatePanels: bool = true)
VARSafeThickenFactor = Input(VARSafeThickenFactor: double = 1.65)
VARCustomGridU = Input(VARCustomGridU: var[]..[] = null)
python_script = Python(IN[0]=VARSurfaces, IN[1]=VARCustomGridU)
# ---------- python_script.python (35 lines) ----------
# Load the Python Standard and DesignScript Libraries
import sys
import clr
clr.AddReference('ProtoGeometry')
from Autodesk.DesignScript.Geometry import *

def empty2null(inpo):
	result = []
	if isinstance(inpo, (list,)):
		if inpo.Count == 0:
			result = None
		else:
			for each in inpo:
				if each == []:
					result.append(None)
				else:
					result.append(each)
	elif inpo == []:
		result = None
	else:
		result = inpo
	return result

surfs = IN[0]
test = empty2null(IN[1])

newlists = []
if test == None:
	for s in surfs:
		newlists.append([None])
else:
	newlists = test

# Assign your output to the OUT variable.
OUT = newlists
# ----------------------------------------
python_script_2 = Python(IN[0]=python_script)
# ---------- python_script_2.python (32 lines) ----------
# Load the Python Standard and DesignScript Libraries
import sys
import clr
clr.AddReference('ProtoGeometry')
from Autodesk.DesignScript.Geometry import *

def flatten(x):
    result = []
    for el in x:
        if hasattr(el, "__iter__") and not isinstance(el, basestring):
            result.extend(flatten(el))
        else:
            result.append(el)
    return result

lists = IN[0]

result = []
for l in lists:
	if l[0] == None:
		result.append([None])
		continue
	try:
		result.append(Geometry.SerializeAsSAB(l))
	except:
		tmp = []
		for l2 in l:
			tmp.append(Geometry.Explode(l2))
		result.append(Geometry.SerializeAsSAB(flatten(tmp)))

# Assign your output to the OUT variable.
OUT = result
# ----------------------------------------
code_block = CodeBlock { 2; }
normalizeDepth = List.NormalizeDepth(list=python_script_2, rank=code_block)
VARCustomGridV = Input(VARCustomGridV: var[]..[] = null)
python_script_3 = Python(IN[0]=VARSurfaces, IN[1]=VARCustomGridV)  # same code as python_script
python_script_4 = Python(IN[0]=python_script_3)  # same code as python_script_2
normalizeDepth_2 = List.NormalizeDepth(list=python_script_4, rank=code_block)
VARCustomGridW = Input(VARCustomGridW: var[]..[] = null)
python_script_5 = Python(IN[0]=VARSurfaces, IN[1]=VARCustomGridW)  # same code as python_script
python_script_6 = Python(IN[0]=python_script_5)  # same code as python_script_2
normalizeDepth_3 = List.NormalizeDepth(list=python_script_6, rank=code_block)
VARWWidth = Input(VARWWidth: double = 0.2)
VARWDepth = Input(VARWDepth: double = 0.05)
VARRemoveSameGridConflict = Input(VARRemoveSameGridConflict: bool = false)
VARUOffset = Input(VARUOffset: double = 0)
VARVOffset = Input(VARVOffset: double = 0)
VARWOffset = Input(VARWOffset: double = 0)
VARPanelOffset = Input(VARPanelOffset: double = 0)
VARBorderOffset = Input(VARBorderOffset: double = 0)
VARIsSolid = Input(VARIsSolid: bool = false)
VARDirectoryPath = Input(VARDirectoryPath: var[]..[])
VARGo = Input(VARGo: bool = false)
VARUCountList = Input(VARUCountList: int[]..[] = null)
VARVCountList = Input(VARVCountList: int[]..[] = null)
VARWCountList = Input(VARWCountList: int[]..[] = null)
python_script_7 = Python(IN[0]=serializeAsSAB, IN[1]=VARBorderDepth, IN[2]=VARBorderWidth, IN[3]=python_empty_2_null, IN[4]=python_empty_2_null_2, IN[5]=VARMethodU, IN[6]=VARMethodV, IN[7]=VARUWidth, IN[8]=VARUDepth, IN[9]=VARVWidth, IN[10]=VARVDepth, IN[11]=VARExtendFix, IN[12]=VARPrecision, IN[13]=VARPanelThickness, IN[14]=VARCreatePanels, IN[15]=VARSafeThickenFactor, IN[16]=normalizeDepth, IN[17]=normalizeDepth_2, IN[18]=normalizeDepth_3, IN[19]=VARWWidth, IN[20]=VARWDepth, IN[21]=VARRemoveSameGridConflict, IN[22]=VARUOffset, IN[23]=VARVOffset, IN[24]=VARWOffset, IN[25]=VARPanelOffset, IN[26]=VARBorderOffset, IN[27]=VARIsSolid, IN[28]=VARDirectoryPath, IN[29]=VARGo, IN[30]=VARUCountList, IN[31]=VARVCountList, IN[32]=VARWCountList)
# ---------- python_script_7.python (39 lines) ----------
# Load the Python Standard and DesignScript Libraries
import sys
import clr
clr.AddReference('ProtoGeometry')
from Autodesk.DesignScript.Geometry import *
import pickle
import os
import clr
clr.AddReference("RevitAPIUI")
from Autodesk.Revit.UI import TaskDialog
	
dataset = [IN[0],IN[1],IN[2],IN[3],IN[4],IN[5],IN[6],IN[7],IN[8],IN[9],IN[10],IN[11],IN[12],IN[13],IN[14],IN[15],IN[16],IN[17],IN[18],IN[19],IN[20],IN[21],IN[22],IN[23],IN[24],IN[25],IN[26],IN[27],IN[30],IN[31],IN[32]]
directorypath = IN[28]
go = IN[29]

if os.path.isdir(directorypath) and go:
	outputFile = "K-Paneling"
	exportpath = directorypath + "\\" + outputFile
	
	i = 1
	while os.path.exists(exportpath + " %s.data" % i) or os.path.exists(exportpath + " %s.data Finished" % i):
	    i += 1
	outputFile = exportpath + " %s.data" % i
	
	fw = open(outputFile, 'wb')
	pickle.dump(dataset, fw)
	fw.close()
	
	# Assign your output to the OUT variable.
	OUT = outputFile
elif go == False:
	OUT = "Nothing to Do"
else:
	if "karam" in directorypath.lower():
		msg = "ERROR: Invalid Export Path\nYou Will Not Find Karam Folder In Your Device"
	else:
		msg = "ERROR: Invalid Export Path"
	title = "AECedx - Karam"
	OUT = TaskDialog.Show(title, msg)
# ----------------------------------------
VAROutput = Output(python_script_7)
