# Dynamo custom node K-Paneling External Process Function.dyf (Dynamo 2.1.0.7500)
# category: Synthesize.Automate.Family
# K-Paneling External Process Function

VARGeometryLists = Input(VARGeometryLists: var[]..[])
VARFiles = Input(VARFiles: var[]..[])
VARIsSolid = Input(VARIsSolid: var[]..[])
VARPreviewGeometry = Input(VARPreviewGeometry: var[]..[])
VARGlazedBorderPreviewColor = Input(VARGlazedBorderPreviewColor: var[]..[])
VARGlazedMullionsPreviewColor = Input(VARGlazedMullionsPreviewColor: var[]..[])
VARGlazedPanelsPreviewColor = Input(VARGlazedPanelsPreviewColor: var[]..[])
VARSolidBorderPreviewColor = Input(VARSolidBorderPreviewColor: var[]..[])
VARSolidSeparatorPreviewColor = Input(VARSolidSeparatorPreviewColor: var[]..[])
VARSolidPanelsPreviewColor = Input(VARSolidPanelsPreviewColor: var[]..[])
VARToggleRunScriptChangetoTrueorFalsethe = Input(VARToggleRunScriptChangetoTrueorFalsethenHitRun: var[]..[])
python_script = Python(IN[0]=VARGeometryLists, IN[1]=VARFiles, IN[2]=VARIsSolid, IN[3]=VARPreviewGeometry, IN[4]=VARGlazedBorderPreviewColor, IN[5]=VARGlazedMullionsPreviewColor, IN[6]=VARGlazedPanelsPreviewColor, IN[7]=VARSolidBorderPreviewColor, IN[8]=VARSolidSeparatorPreviewColor, IN[9]=VARSolidPanelsPreviewColor, IN[10]=VARToggleRunScriptChangetoTrueorFalsethe)
# ---------- python_script.python (132 lines) ----------
# Load the Python Standard and DesignScript Libraries
import sys
import clr
clr.AddReference('ProtoGeometry')
from Autodesk.DesignScript import Geometry as dg
clr.AddReference('GeometryColor')
from Modifiers import GeometryColor
import os
import shutil
import clr
clr.AddReference("System.Windows.Forms")
from System.Windows.Forms import Form,Label

lists = IN[0]
f = IN[1]
solidstatus = IN[2]
previewgeometry = IN[3]
gborder = IN[4]
gmullions = IN[5]
gpanels = IN[6]
sborder = IN[7]
sseparator = IN[8]
spanels = IN[9]

def clean_null(list):
	clean = []
	try:
		for l in list:
			if l != None:
				clean.append(l)
	except:
		return list
	return clean

def tryexport(geoms,name,previewgeometry):
	geoms = clean_null(geoms)
	try:
		if len(geoms) != 0:
			dg.Geometry.ExportToSAT(geoms,name)
			if previewgeometry == False:
				for g in geoms:
					g.Dispose()
	except:
		pass

def trymove(old,new):
	try:
		shutil.move(old,new)
	except:
		pass

def trycolor(geoms,color):
	geoms = clean_null(geoms)
	colored = []
	try:
		for g in geoms:
			colored.append(GeometryColor.ByGeometryColor(g,color))
	except:
		pass
	return colored

def popup(text):
	form = Form()
	form.Width = 600
	form.Height = 600
	label = Label()
	label.Text = text
	label.Width = 600
	label.Height = 600
	label.Parent = form	
	form.ShowDialog()

count = 0
coloredgeometry = []
conflicts = []
for l in lists:
	tmpcolored = []
	file = f[count]
	IsSolid = solidstatus[count]
	count += 1
	try:
		mullions = l[0]
	except:
		mullions = []
	try:
		panels = l[1]
	except:
		panels = []
	try:
		frames = l[2]
	except:
		frames = []
	if IsSolid:
		solidextra = " Solid"
		if previewgeometry:
			tmpcolored.append(trycolor(frames,sborder))
			tmpcolored.append(trycolor(mullions,sseparator))
			tmpcolored.append(trycolor(panels,spanels))
	else:
		solidextra = ""
		if previewgeometry:
			tmpcolored.append(trycolor(frames,gborder))
			tmpcolored.append(trycolor(mullions,gmullions))
			tmpcolored.append(trycolor(panels,gpanels))
	if previewgeometry:
		coloredgeometry.append(tmpcolored)
	mullionsname = file + solidextra + " Mullions.sat"
	panelsname = file + solidextra + " Panels.sat"
	framesname = file + solidextra + " Frames.sat"
	newfold = file + " Tmp"
	if os.path.isdir(file + " Finished"):
		conflicts.append(file + " Finished")
		continue
	elif os.path.isdir(file) == False:
		os.makedirs(newfold)
		tryexport(mullions,mullionsname,previewgeometry)
		tryexport(panels,panelsname,previewgeometry)
		tryexport(frames,framesname,previewgeometry)
		trymove(mullionsname,newfold)
		trymove(panelsname,newfold)
		trymove(framesname,newfold)
		trymove(file,newfold)
		os.rename(newfold, file)

if len(conflicts) != 0:
	conflicts.insert(0,"ERROR: 'Finished' Folders Found:")
	conflicts.append("\nCheck If You Have Already Imported Them to Revit\nOtherwise Delete The Folders Containing 'Finished' then Toggle Run The Script Again.")
	popup("\n".join(conflicts))
if previewgeometry:
	OUT = coloredgeometry
else:
	OUT = "Finished"
# ----------------------------------------
VAROuput = Output(python_script)
