# Dynamo custom node K-Paneling Sandbox.dyf (Dynamo 2.1.0.7500)
# category: Synthesize.Automate.Family
# K-Paneling

VARSurfaces = Input(VARSurfaces: var[]..[])
VARBorderDepth = Input(VARBorderDepth: double = 0.2)
VARBorderWidth = Input(VARBorderWidth: double = 0.1)
VARDistanceU = Input(VARDistanceU: double[])
VARDistanaceV = Input(VARDistanaceV: double[])
VARMethodU = Input(VARMethodU: bool = false)
VARMethodV = Input(VARMethodV: bool = false)
VARUWidth = Input(VARUWidth: double = 0.2)
VARUDepth = Input(VARUDepth: double = 0.15)
VARVWidth = Input(VARVWidth: double = 0.2)
VARVDepth = Input(VARVDepth: double = 0.2)
VARExtendFix = Input(VARExtendFix: double = 3.3)
VARPrecision = Input(VARPrecision: double = 1.15)
VARPanelThickness = Input(VARPanelThickness: double = 0.03)
VARCreatePanels = Input(VARCreatePanels: bool = true)
VARSafeThickenFactor = Input(VARSafeThickenFactor: double = 1.65)
VARCustomGridU = Input(VARCustomGridU: var[]..[] = null)
VARCustomGridV = Input(VARCustomGridV: var[]..[] = null)
VARCustomGridW = Input(VARCustomGridW: var[]..[] = null)
VARWWidth = Input(VARWWidth: double = 0.2)
VARWDepth = Input(VARWDepth: double = 0.05)
VARRemoveSameGridConflict = Input(VARRemoveSameGridConflict: bool = false)
VARUOffset = Input(VARUOffset: double = 0)
VARVOffset = Input(VARVOffset: double = 0)
VARWOffset = Input(VARWOffset: double = 0)
VARPanelOffset = Input(VARPanelOffset: double = 0)
VARBorderOffset = Input(VARBorderOffset: double = 0)
python_script = Python(IN[0]=VARSurfaces, IN[1]=VARBorderDepth, IN[2]=VARBorderWidth, IN[3]=VARDistanceU, IN[4]=VARDistanaceV, IN[5]=VARMethodU, IN[6]=VARMethodV, IN[7]=VARUWidth, IN[8]=VARUDepth, IN[9]=VARVWidth, IN[10]=VARVDepth, IN[11]=VARExtendFix, IN[12]=VARPrecision, IN[13]=VARPanelThickness, IN[14]=VARCreatePanels, IN[15]=VARSafeThickenFactor, IN[16]=VARCustomGridU, IN[17]=VARCustomGridV, IN[18]=VARCustomGridW, IN[19]=VARWWidth, IN[20]=VARWDepth, IN[21]=VARRemoveSameGridConflict, IN[22]=VARUOffset, IN[23]=VARVOffset, IN[24]=VARWOffset, IN[25]=VARPanelOffset, IN[26]=VARBorderOffset)
# ---------- python_script.python (1646 lines) ----------
# Proudly Created By Karam Baki : karam@aecedx.com
# Enable Python support and load DesignScript library
# IMPORTANT : ALL DYNAMO DESIGN SCRIPT NODES ARE AS (dg)
import clr
clr.AddReference('ProtoGeometry')
from Autodesk.DesignScript import Geometry as dg

# Enable ICollection List Translate
clr.AddReference("System")
import System.Collections.Generic
from System.Collections.Generic import List
import math

import System
pf_path = System.Environment.GetFolderPath(System.Environment.SpecialFolder.ProgramFilesX86)
import sys
sys.path.append('%s\IronPython 2.7\Lib' %pf_path)
from distutils.version import LooseVersion

from threading import Thread
import multiprocessing

class ThreadWithReturnValue(Thread):
    def __init__(self, group=None, target=None, name=None,
                    args=(), kwargs={}, Verbose=None):
        Thread.__init__(self, group, target, name, args, kwargs, Verbose)
        self._return = None
    def run(self):
        if self._Thread__target is not None:
            self._return = self._Thread__target(*self._Thread__args,
                                                **self._Thread__kwargs)
    def join(self):
        Thread.join(self)
        return self._return

def multithreadrun2inputs(listofstuff,targetDef,input1,input2):

	def chop(l1, n):
		return [l1[x:x+n] for x in xrange(0, len(l1), n)]
	def tolist(obj1):
		if obj1 == []:
			return [[]]
		if hasattr(obj1,'__iter__'): return obj1
		else: return [obj1]
	cpus = multiprocessing.cpu_count() - 1
	elemsnum = len(listofstuff)
	if elemsnum < cpus:
		cpus = elemsnum
	try:
		chopped = chop(listofstuff,elemsnum/cpus)
	except:
		return []
	threads = []
	for chop in chopped:
		th = ThreadWithReturnValue(target=targetDef, args=(chop,input1,input2))
		th.start()
		threads.append(th)
	results = []
	for th in threads:
		result = tolist(th.join())
		for r in result:
			results.append(r)
	return results

def flatten(x):
    result = []
    for el in x:
        if hasattr(el, "__iter__") and not isinstance(el, basestring):
            result.extend(flatten(el))
        else:
            result.append(el)
    return result

def tolist(obj1):
	if hasattr(obj1,'__iter__'): return obj1
	else: return [obj1]

def empty2null(inpo):
	result = []
	if isinstance(inpo, (list,)):
		if inpo.Count == 0:
			result = None
		else:
			for each in inpo:
				if each == []:
					result.append(None)
				else:
					result.append(each)
	elif inpo == []:
		result = None
	else:
		result = inpo
	return result

def cleanupSurface(surface):
	def meternumber(value):
		value = value
		return value
	def metersurfarea(surface):
		area = meternumber(surface.Area)
		return area
	def almostsame(surf1,surf2,tollerance = 3):
		if round(metersurfarea(surf1),tollerance) == round(metersurfarea(surf2),tollerance):
			return True
		else:
			return False
	def subtractfunction(nurbs,cleanexplodes):
		def loopclean(nurbs,thick,counter):
			result = dg.Surface.SubtractFrom(nurbs,thick)[0]
			if counter != 0:
				nurbs.Dispose()
			thick.Dispose()
			return result
		thickforms = []
		for cleanex in cleanexplodes:
			safearea = metersurfarea(cleanex)/10
			if safearea > meternumber(0.1):
				maxthicken = meternumber(0.1)
			else:
				maxthicken = safearea
			thickforms.append(dg.Surface.Thicken(cleanex,maxthicken,True))
		counter = 0
		for thick in thickforms:
			nurbs = loopclean(nurbs,thick,counter)
			counter += 1
		return nurbs
	def tryingforall(surface,nurbs,cleanexplodes,geometrymode):
		try:
			finalsub = subtractfunction(nurbs,cleanexplodes)
			return [finalsub]
		except:
			try:
				finalsub = dg.Surface.Difference(nurbs,cleanexplodes)
				return [finalsub]
			except Exception as e:
				if str(e) == "Cannot difference an empty list" and almostsame(nurbs,surface):
					finalsub = nurbs
					try:
						return [finalsub]
					except:
						return None
	def gencleanexplodes(subtractnurbs):
		if isinstance(subtractnurbs, list):
			if len(subtractnurbs) == 0:
				return []
		else:
			explodednurbs = dg.Geometry.Explode(subtractnurbs)
			cleanexplodes = []
			if safemode:
				for ex in explodednurbs:
					if ex.Area < meternumber(0.002):
						ex.Dispose()
					else:
						cleanexplodes.append(ex)
			else:
				cleanexplodes = list(explodednurbs)
			subtractnurbs.Dispose()
			return cleanexplodes
	def easymethod(surface,geometrymode):
		try:
			nurbs = dg.Surface.ToNurbsSurface(surface)
			if almostsame(nurbs,surface):
				try:
					return True,[nurbs]
				except:
					return None,nurbs
			else:
				return None,nurbs
		except:
			return None,None
	def isplanarsurf(s):
		norms = [0,0.333,0.666,1]
		pts = []
		for n in norms:
			for n2 in norms:
				pts.append(dg.Surface.PointAtParameter(s,n,n2))
		plane = dg.Plane.ByBestFitThroughPoints(pts)
		status = True
		for p in pts:
			try:
				inter = dg.Geometry.DoesIntersect(p,plane)
				if inter == False:
					status = False
					break
			except:
				pass
		return status
	def joincurves(crvs):
		def PointsEqual(pt1, pt2):
			tolerance = 0.00001
			if (math.fabs(pt1.X - pt2.X) < tolerance and
				math.fabs(pt1.Y - pt2.Y) < tolerance and
				math.fabs(pt1.Z - pt2.Z) < tolerance):
				return True
			else:
				return False
		crvs = flatten(tolist(crvs))
		crvGroup = [-1 for x in range(len(crvs))]
		crvGroup[0] = 0
		maxGroupNum = 1
		starts = []
		ends = []
		for crv in crvs:
			starts.append(crv.PointAtParameter(0))
			ends.append(crv.PointAtParameter(1))
		for i in range(len(crvs)):
			if (crvGroup[i] == -1):
				crvGroup[i] = i
			for j in range(len(crvs)):
				if (i != j and
					(PointsEqual(starts[i], starts[j]) or
					PointsEqual(starts[i], ends[j]) or
					PointsEqual(ends[i], starts[j]) or
					PointsEqual(ends[i], ends[j]))):
					if (crvGroup[j] == -1):
						crvGroup[j] = crvGroup[i]
					elif (crvGroup[i] != crvGroup[j]):
						oldNum = crvGroup[j]
						for k in range(len(crvs)):
							if (crvGroup[k] == oldNum):
								crvGroup[k] = crvGroup[i]
		groups = []
		excluded = []
		for n in crvGroup:
			innercount = 0
			tmp = []
			for n2 in crvGroup:
				if n == n2 and n2 not in excluded:
					tmp.append(crvs[innercount])
				innercount += 1
			if len(tmp) == 0:
				continue
			try:
				tmp = dg.PolyCurve.ByJoinedCurves(tmp)
				groups.append(tmp)
			except:
				for t in tmp:
					groups.append(dg.PolyCurve.ByJoinedCurves([t]))
			excluded.append(n)
		joinedcurves = groups
		return joinedcurves
	def trimloopmethod(surface,nurbs,geometrymode):
		try:
			if surface.Closed:
				return None
			try:
				joinedperms = [dg.PolyCurve.ByJoinedCurves(surface.PerimeterCurves())]
			except:
				joinedperms = joincurves(surface.PerimeterCurves())
			finalsub = dg.Surface.TrimWithEdgeLoops(nurbs,joinedperms)
			if almostsame(finalsub,surface):
				return [finalsub]
			else:
				return None
		except:
			return None
	def thickenintersectMethod(surface,nurbs,geometrymode,pointOneMeter):
		try:
			tmp_thicken = dg.Surface.Thicken(surface,pointOneMeter,True)
			isplanar = isplanarsurf(surface)
			if isplanar:
				tmp_pt = dg.Surface.PointAtParameter(surface,0.5,0.5)
				tmp_norm = dg.Surface.NormalAtPoint(surface,tmp_pt)
				intersecter = dg.Plane.ByOriginNormal(tmp_pt,tmp_norm)
				finalsub = dg.Geometry.Intersect(intersecter,tmp_thicken)
				for f in finalsub:
					if isinstance(f,dg.Surface):
						finalsub = f
						break
				tmp_thicken.Dispose()
			else:
				finalsub = dg.Geometry.Intersect(nurbs,tmp_thicken)
				for f in finalsub:
					if isinstance(f,dg.Surface):
						finalsub = f
						break
				tmp_thicken.Dispose()
			return [finalsub]
		except:
			return None
	def inithickenMethod(surface,nurbs,geometrymode):
		try:
			safearea = metersurfarea(surface)/10
			if safearea > meternumber(0.1):
				maxthicken = meternumber(0.1)
			else:
				maxthicken = safearea
			thickeninit = dg.Surface.Thicken(surface,maxthicken,True)
			try:
				subtractnurbs = dg.Surface.SubtractFrom(nurbs,thickeninit)[0]
			except Exception as e:
				if "index out of range" in str(e) and almostsame(nurbs,surface):
					subtractnurbs = []
				elif "index out of range" in str(e):
					try:
						subtractnurbs = dg.Surface.Difference(nurbs,[surface])
					except Exception as e:
						if str(e) == "Unable to get FACE from BODY: no faces in BODY":
							subtractnurbs = []
			thickeninit.Dispose()
			cleanexplodes = gencleanexplodes(subtractnurbs)
			tryall = tryingforall(surface,nurbs,cleanexplodes,geometrymode)
			if tryall != None:
				return tryall
			else:
				return None
		except:
			return None
	def simplesubmethod(surface,nurbs,geometrymode):
		try:
			try:
				subtractnurbs = dg.Surface.Difference(nurbs,[surface])
			except Exception as e:
				if str(e) == "Unable to get FACE from BODY: no faces in BODY":
					try:
						return [nurbs]
					except:
						return None
			cleanexplodes = gencleanexplodes(subtractnurbs)
			tryall = tryingforall(surface,nurbs,cleanexplodes,geometrymode)
			if tryall != None:
				return tryall
			else:
				return None
		except:
			return None
	geometrymode = True
	safemode = False
	pointOneMeter = 0.1
	easy = easymethod(surface,geometrymode)
	if easy[0] != None:
		return easy[1][0]
	elif easy[0] == None and easy[1] == None:
		return surface
	else:
		nurbs = easy[1]
	trimloop = trimloopmethod(surface,nurbs,geometrymode)
	if trimloop != None:
		return trimloop[0]
	simple = simplesubmethod(surface,nurbs,geometrymode)
	if simple != None:
		return simple[0]
	inithick = inithickenMethod(surface,nurbs,geometrymode)
	if inithick != None:
		return inithick[0]
	thickeninter = thickenintersectMethod(surface,nurbs,geometrymode,pointOneMeter)
	if thickeninter != None:
		return thickeninter[0]
	else:
		return surface

def isplanarsurf(s):
	norms = [0,0.333,0.666,1]
	pts = []
	for n in norms:
		for n2 in norms:
			pts.append(dg.Surface.PointAtParameter(s,n,n2))
	plane = dg.Plane.ByBestFitThroughPoints(pts)
	status = True
	for p in pts:
		try:
			inter = dg.Geometry.DoesIntersect(p,plane)
			if inter == False:
				status = False
				break
		except:
			pass
	return status

def iscurvesurf(s):
	norms = [0,0.333,0.666,1]
	try:
		for n in norms:
			curve1 = dg.Geometry.Explode(dg.Curve.ByIsoCurveOnSurface(s,0,n))[0]
			curve2 = dg.Geometry.Explode(dg.Curve.ByIsoCurveOnSurface(s,1,n))[0]
			if (isinstance(curve1, dg.Line) or isinstance(curve1, dg.Circle)) and (isinstance(curve2, dg.Line) or isinstance(curve2, dg.Circle)):
				continue
			else:
				isgood = False
				try:
					arclength1 = dg.Arc.ByThreePoints(curve1.StartPoint,dg.Curve.PointAtParameter(curve1,0.5),curve1.EndPoint).Length
					if round(arclength1,2) == round(curve1.Length):
						continue
					else:
						return False
				except:	
					isgood = True
					pass
				try:
					arclength2 = dg.Arc.ByThreePoints(curve2.StartPoint,dg.Curve.PointAtParameter(curve2,0.5),curve2.EndPoint).Length
					if round(arclength2,2) == round(curve2.Length):
						continue
					else:
						return False
				except:
					isgood = True
					pass
				if isgood:
					continue
		return True
	except:
		return False

dataEnteringNode = IN
# Use UnwrapElement(IN[0]) When Translating From Dynamo to Revit
surfs= (tolist(IN[0]))
bord = IN[1]
borw = IN[2]
distanceU = empty2null(tolist(IN[3]))
distanceV = empty2null(tolist(IN[4]))
panmethodU = IN[5]
panmethodV = IN[6]
uwidth = IN[7]
udepth = IN[8]
vwidth = IN[9]
vdepth = IN[10]
extendfix = IN[11]
precision = IN[12]
panelthickness = IN[13]
createpanels = IN[14]
safethickfactor = IN[15]
customgridsu = empty2null(IN[16])
customgridsv = empty2null(IN[17])
customgridsw = empty2null(IN[18])
wwidth = IN[19]
wdepth = IN[20]
removeconflict = IN[21]
uoffset = IN[22]
voffset = IN[23]
woffset = IN[24]
panelsoffset = IN[25]
frameoffset = IN[26]

cleanedsurfs = []
for s in surfs:
	if isplanarsurf(s) or iscurvesurf(s):
		cleanedsurfs.append(s)
	else:
		cleanedsurfs.append(cleanupSurface(s))
surfs = cleanedsurfs

mincompare = []
if udepth != 0:
	mincompare.append(udepth)
if vdepth != 0:
	mincompare.append(vdepth)
if bord != 0:
	mincompare.append(bord)
mindepth = min(mincompare)

if bord == 0:
	borw = 0
if borw == 0:
	bord = 0

def matchlist(surfs,replica):
	fixdcustomgridsw = []
	nums = range(len(surfs))
	for n in nums:
		fixdcustomgridsw.append(replica)
	return fixdcustomgridsw

if customgridsw == None:
	customgridsw = matchlist(surfs,[None])

if empty2null(IN[3]) == None:
	distanceU = matchlist(surfs,0)

if empty2null(IN[4]) == None:
	distanceV = matchlist(surfs,0)

precision = precision * 0.3048
extendfix = extendfix * 0.3048
safethickfactor = safethickfactor * 0.3048

def joincurves(crvs):
	def PointsEqual(pt1, pt2):
		tolerance = 0.00001
		if (math.fabs(pt1.X - pt2.X) < tolerance and
		    math.fabs(pt1.Y - pt2.Y) < tolerance and
		    math.fabs(pt1.Z - pt2.Z) < tolerance):
			return True
		else:
			return False
	crvs = flatten(tolist(crvs))
	crvGroup = [-1 for x in range(len(crvs))]
	crvGroup[0] = 0
	maxGroupNum = 1
	starts = []
	ends = []
	for crv in crvs:
		starts.append(crv.PointAtParameter(0))
		ends.append(crv.PointAtParameter(1))
	for i in range(len(crvs)):
		if (crvGroup[i] == -1):
			crvGroup[i] = i
		for j in range(len(crvs)):
			if (i != j and
				(PointsEqual(starts[i], starts[j]) or
				PointsEqual(starts[i], ends[j]) or
				PointsEqual(ends[i], starts[j]) or
				PointsEqual(ends[i], ends[j]))):
				if (crvGroup[j] == -1):
					crvGroup[j] = crvGroup[i]
				elif (crvGroup[i] != crvGroup[j]):
					oldNum = crvGroup[j]
					for k in range(len(crvs)):
						if (crvGroup[k] == oldNum):
							crvGroup[k] = crvGroup[i]
	groups = []
	excluded = []
	for n in crvGroup:
		innercount = 0
		tmp = []
		for n2 in crvGroup:
			if n == n2 and n2 not in excluded:
				tmp.append(crvs[innercount])
			innercount += 1
		if len(tmp) == 0:
			continue
		try:
			tmp = dg.PolyCurve.ByJoinedCurves(tmp)
			groups.append(tmp)
		except:
			for t in tmp:
				groups.append(t)
		excluded.append(n)
	joinedcurves = groups
	return joinedcurves

def fixcurve(curve,precision):
	exlength = curve.Length/precision
	normed  = normalize(exlength)
	tmpin = []
	for norm in normed:
		pin = dg.Curve.PointAtParameter(curve,norm)
		tmpin.append(pin)
	wanted = dg.NurbsCurve.ByPoints(tmpin)
	return wanted

def exlines(curve,extendfix,precision,start,end):
	explodeus = dg.Geometry.Explode(curve)
	fixedcurves = []
	counter = 0
	lastitem = len(explodeus) - 1
	for ex in explodeus:
		if len(explodeus) > 1 and counter == 0 and start == True:
			fixedcurves.append(fixcurve(dg.Curve.ExtendStart(fixcurve(ex,precision),extendfix),precision))
		elif len(explodeus) > 1 and counter == lastitem and end == True:
			fixedcurves.append(fixcurve(dg.Curve.ExtendEnd(fixcurve(ex,precision),extendfix),precision))
		else:
			fixedme = fixcurve(ex,precision)
			if start == True:
				fixedme = fixcurve(dg.Curve.ExtendStart(fixedme),precision)
			if end == True:
				fixedme = fixcurve(dg.Curve.ExtendEnd(fixedme),precision)
			fixedcurves.append(fixedme)
		counter += 1
	wantedfix = dg.PolyCurve.ByJoinedCurves(fixedcurves)
	return wantedfix

def truemeasure(c,currentsurf):
	try:
		splits = dg.Geometry.Split(c,currentsurf)
	except:
		splits = []
	innercounter = 0
	goodsplits = []
	for s in splits:
		point = dg.Curve.PointAtParameter(s,0.5)
		if dg.Geometry.DoesIntersect(currentsurf,point) and round(s.Length,1) != 0:
			goodsplits.append(splits[innercounter])
		innercounter += 1
	totalmeasure = []
	for spl in goodsplits:
		try:
			totalmeasure.append(spl.Length)
		except:
			pass
	wantedlength = sum(totalmeasure)
	return wantedlength

def bulktruemeasure(currentsurf,uv):
	times = normalize(20)
	lengths = []
	for t in times:
		lengths.append(truemeasure(dg.Surface.GetIsoline(currentsurf,uv,t),currentsurf))
	wanted = round(max(lengths),3)
	return wanted

def getbestold(fixedexploded,bord,solid):
	tmpareas = []
	for x in fixedexploded:
		tmpareas.append(x.Area)
	status = "Again"
	while status == "Again":
		maxarea = max(tmpareas)
		innercount = 0
		for r in tmpareas:
			if maxarea == r:
				point_onsurf = dg.Surface.PointAtParameter(fixedexploded[innercount])
				vec_onsurf = dg.Surface.NormalAtParameter(fixedexploded[innercount])
				transformed = dg.Geometry.Translate(point_onsurf,vec_onsurf,bord/1.5)
				if dg.Geometry.DoesIntersect(transformed,solid):
					fixedexploded.pop(innercount)
					tmpareas.pop(innercount)
					status = "Again"
					break
				else:
					surfi = fixedexploded.pop(innercount)
					wanted1 = dg.Surface.Thicken(surfi,borw*-1,False)
					surfi.Dispose()
					tmpareas.pop(innercount)
					status = "Stop"
					break
			innercount += 1
	return wanted1,fixedexploded

def framesv1(surfs,bord,borw):
	thickned = []
	wantedwitdh = borw  * 2
	wanteddepth = wantedwitdh + bord
	thickned = dg.Surface.Thicken(surfs,wanteddepth,True)
	count = 0
	thinedshell = dg.Solid.ThinShell(thickned,borw,0)
	exploded = dg.Geometry.Explode(thinedshell)
	fixedexploded = []
	for x in exploded:
		fixedexploded.append(x)
	wanted = getbestold(fixedexploded,bord,thickned)
	wanted1 = wanted[0]
	wanted2 = getbestold(wanted[1],bord,thickned)[0]
	allwants = [wanted1,wanted2]
	finalresult = dg.Solid.DifferenceAll(thinedshell,allwants)
	thickned.Dispose()
	thinedshell.Dispose()
	for x in fixedexploded:
		x.Dispose()
	return finalresult

def framesv2(surfs,bord,borw):
	frames = []
	thicken = dg.Surface.Thicken(surfs,bord)
	exploded = dg.Geometry.Explode(thicken)[2:]
	joined = joinsurfs(exploded)
	prejointhicken = []
	for j in joined:
		prejointhicken.append(dg.Surface.Thicken(j,-borw,False))
	unioned = dg.Solid.ByUnion(prejointhicken)
	for x in exploded:
		x.Dispose()
	for j in joined:
		j.Dispose()
	thicken.Dispose()
	for j in prejointhicken:
		j.Dispose()
	return unioned

def framesv3(surfs,bord,borw):
	frames = []
	try:
		thicken = dg.Surface.Thicken(surfs,bord)
	except:
		permpan = dg.PolyCurve.ByJoinedCurves(surfs.PerimeterCurves())
		patchedpan = dg.Surface.ByPatch(permpan)
		thicken = dg.Surface.Thicken(patchedpan,bord,True)
		permpan.Dispose()
	exploded = dg.Geometry.Explode(thicken)[2:]
	thickenex = []
	for x in exploded:
		try:
			thickenex.append(dg.Surface.Thicken(x,borw*2,True))	
		except:
			pass
	s = patchedpan
	for int in thickenex:
		s = dg.Surface.SubtractFrom(s,int)[0]
	slisted = [s]
	inverse = dg.Surface.Difference(patchedpan,slisted)
	return inverse,thickenex

def joinsurfs(surfs):
	def surf_doesinter(a,b,tollerance = 0.00001):
		if round(dg.Geometry.DistanceTo(a,b),2) < tollerance:
			return True
		else:
			return False
	surfacesflatten = flatten(surfs)
	surfacesflatten = [x for x in surfacesflatten if x]
	if surfacesflatten != None and surfacesflatten != []:
		crvs = flatten(tolist(surfs))
		crvGroup = [-1 for x in range(len(crvs))]
		crvGroup[0] = 0
		maxGroupNum = 1
		for i in range(len(crvs)):
			if (crvGroup[i] == -1):
				crvGroup[i] = i
			for j in range(len(crvs)):
				try:
					if i != j and surf_doesinter(crvs[i], crvs[j]):
						if (crvGroup[j] == -1):
							crvGroup[j] = crvGroup[i]
						elif (crvGroup[i] != crvGroup[j]):
							oldNum = crvGroup[j]
							for k in range(len(crvs)):
								if (crvGroup[k] == oldNum):
									crvGroup[k] = crvGroup[i]
				except:
					pass
		groups = []
		excluded = []
		for n in crvGroup:
			innercount = 0
			tmp = []
			for n2 in crvGroup:
				if n == n2 and n2 not in excluded:
					tmp.append(crvs[innercount])
				innercount += 1
			if len(tmp) == 0:
				continue
			try:
				tmp = dg.Surface.ByUnion(tmp)
				groups.append(tmp)
			except:
				try:
					tmp = dg.PolySurface.ByJoinedSurfaces(tmp)
					groups.append(tmp)
				except:
					for t in tmp:
						groups.append(t)
			excluded.append(n)
		joinedsurfs = groups
		return joinedsurfs
	else:
		return surfs

def normalize(length,nostartend = False,twominonly = False):
	if length != None:
		if length <= 3 and twominonly == False:
			length = 4
		elif length <= 3 and twominonly == True:
			if length < 2:
				length = 2
		if nostartend:
			length += 2
		a = range(0,int(length))
		points = []
		amin, amax = min(a), max(a)
		item = []
		for val in a:
			item.append(float(val-amin) / float(amax-amin))
	else:
		item = [None]
	if nostartend == True:
		item.pop(0)
		item.pop(-1)
	return item

def initialgrids(subbedsurfs,distanceU,distanceV,panmethodU,panmethodV,allsurfs):
	nurbs_surfs = []
	for a in allsurfs:
		nurbs_surfs.append(a)
	
	isolineU = []
	isolineV = []
	
	counter = 0
	for n in nurbs_surfs:
		disU = distanceU[counter]
		disV = distanceV[counter]
		counter += 1
		if panmethodU == False and disU != 0:
			ulen = disU + 2
		elif disU != 0:
			wanUlen = bulktruemeasure(n,0)
			utest = math.ceil(wanUlen/disU)
			try:
				if wanUlen/utest < disU:
					utest = utest - 1
				ulen = utest + 1
			except:
				ulen = None
		else:
			ulen = None
		isolineU.append(ulen)
		
		if panmethodV == False and disV != 0:
			vlen = disV + 2
		elif disV != 0:
			wanVlen = bulktruemeasure(n,1)
			vtest = math.ceil(wanVlen/disV)
			try:
				if wanVlen/vtest < disV:
					vtest = vtest - 1
				vlen = vtest + 1
			except:
				vlen = None
		else:
			vlen = None
		isolineV.append(vlen)
	
	normsU = []
	for u in isolineU:
		normedu = normalize(u,False,True)
		normedu = normedu[1:]
		if normedu == []:
			normedu = [[]]
		normsU.append(normedu)
		
	permall = []
	for surf in allsurfs:
		perms = surf.PerimeterCurves()
		permsfix = []
		for perm in perms:
			permsfix.append(perm)
		permall.append(len(permsfix))
		for perm in perms:
			perm.Dispose()
		
	gridsu = []
	counter = 0
	for surf in allsurfs:
		tmp = []
		currentpu = normsU[counter]
		for p in currentpu:
			try:
				if permall[counter] == 1:
					tmp.append(dg.Surface.GetIsoline(subbedsurfs[counter],1,p))
				else:
					if p == 0 or p == 1:
						tmp.append(dg.Surface.GetIsoline(subbedsurfs[counter],1,p))
					else:
						tmp.append(dg.Surface.GetIsoline(surf,1,p))
			except:
				tmp.append(None)
		counter += 1
		gridsu.append(tmp)
	
	normsV = []
	for v in isolineV:
		normedv = normalize(v,False,True)
		normedv = normedv[1:]
		if normedv == []:
			normedv = [[]]
		normsV.append(normedv)
	
	gridsv = []
	counter = 0
	for surf in allsurfs:
		tmp = []
		currentpv = normsV[counter]
		for p in currentpv:
			try:
				if permall[counter] == 1:
					tmp.append(dg.Surface.GetIsoline(subbedsurfs[counter],0,p))
				else:
					if p == 0 or p == 1:
						tmp.append(dg.Surface.GetIsoline(subbedsurfs[counter],0,p))
					else:
						tmp.append(dg.Surface.GetIsoline(surf,0,p))
			except:
				tmp.append(None)
		counter += 1
		gridsv.append(tmp)
	return gridsu,gridsv

def flatten(x):
    result = []
    for el in x:
        if hasattr(el, "__iter__") and not isinstance(el, basestring):
            result.extend(flatten(el))
        else:
            result.append(el)
    return result

def doesinter(a,b,tollerance = 0.05):
	if round(dg.Geometry.DistanceTo(a,b),2) < tollerance:
		return True
	else:
		return False

def gridfunction(currentsurf,extended,precision,uwidth,udepth,isplanar):
	exlength = extended.Length/precision
	normed  = normalize(exlength)
	tmpin1 = []
	tmpin2 = []
	res = []
	planarbool = []
	directconvert = False
	try:
		explodedcurves = dg.PolyCurve.ByJoinedCurves([extended]).Curves()
	except:
		try:
			explodedcurves = dg.Geometry.Explode(extended)
		except:
			explodedcurves = [extended]
	if len(explodedcurves) > 1:
		try:
			if isplanar:
				pin = dg.Curve.PointAtParameter(extended,0.5)
				pinnormal = dg.Surface.NormalAtPoint(currentsurf,pin)
				tranpin = dg.Geometry.Translate(extended,pinnormal,udepth/2.0)
				tranpin2 = dg.Geometry.Translate(extended,pinnormal,-udepth/2.0)
				wanted1 = tranpin
				wanted2 = tranpin2
				directconvert = True
			else:
				returned = explodedcurves
				retwanted1 = []
				retwanted2 = []
				for ret in returned:
					retlength = ret.Length/precision
					retnormed  = normalize(retlength)
					rettmpin1 = []
					rettmpin2 = []
					for retnorm in retnormed:
						retpin = dg.Curve.PointAtParameter(ret,retnorm)
						retpinnormal = dg.Surface.NormalAtPoint(currentsurf,retpin)
						rettranpin = dg.Geometry.Translate(retpin,retpinnormal,udepth/2.0)
						rettranpin2 = dg.Geometry.Translate(retpin,retpinnormal,-udepth/2.0)
						rettmpin1.append(rettranpin)
						rettmpin2.append(rettranpin2)
					retwanted1.append(dg.NurbsCurve.ByPoints(rettmpin1))
					retwanted2.append(dg.NurbsCurve.ByPoints(rettmpin2))
				wanted1 = dg.PolyCurve.ByJoinedCurves(retwanted1)
				wanted2 = dg.PolyCurve.ByJoinedCurves(retwanted2)
				directconvert = True
		except:
			directconvert = False
	if directconvert == False:
		for norm in normed:
			pin = dg.Curve.PointAtParameter(extended,norm)
			pinnormal = dg.Surface.NormalAtPoint(currentsurf,pin)
			tranpin = dg.Geometry.Translate(pin,pinnormal,udepth/2.0)
			tranpin2 = dg.Geometry.Translate(pin,pinnormal,-udepth/2.0)
			tmpin1.append(tranpin)
			tmpin2.append(tranpin2)
		wanted1 = dg.NurbsCurve.ByPoints(tmpin1)
		wanted2 = dg.NurbsCurve.ByPoints(tmpin2)
	loftbody = False
	try:
		loftbody = dg.Surface.ByLoft([wanted1,wanted2])
	except:
		exploded1 = dg.Geometry.Explode(wanted1)
		exploded2 = dg.Geometry.Explode(wanted2)
		wcount = 0
		for w in exploded1:
			w2 = exploded2[wcount]
			wcount += 1
			loftmini = dg.Surface.ByLoft([w,w2])
			w.Dispose()
			w2.Dispose()
			try:
				res.append(dg.Surface.Thicken(loftmini,uwidth,True))
				loftmini.Dispose()
			except:
				loftmini.Dispose()
	if len(res) == 0 and loftbody != False:
		try:
			res.append(dg.Surface.Thicken(loftbody,uwidth,True))
			loftbody.Dispose()
		except:
			explodedloft = dg.Geometry.Explode(loftbody)
			for exp in explodedloft:
				try:
					res.append(dg.Surface.Thicken(exp,uwidth,True))
					exp.Dispose()
				except:
					exp.Dispose()
	planarbool.append(isplanar)
	return res,planarbool

def solidgrids(allsurfs,inversedlist,borw,gridsu,uwidth,udepth,extendfix,splitmode):
	counter = 0
	splittedu = []
	planaru = []
	for listu in gridsu:
		tmp = []
		planartmp = []
		currentsurf = allsurfs[counter]
		isplanar= isplanarsurf(currentsurf)
		currentinvert = inversedlist[counter]
		try:
			try:
				if borw == 0 or splitmode == True:
					percurves = currentsurf.PerimeterCurves()
				else:
					percurves = currentinvert.PerimeterCurves()
			except:
				try:
					if borw == 0 or splitmode == True:
						percurves = currentsurf.FlipNormalDirection().PerimeterCurves()
					else:
						percurves = currentinvert.PerimeterCurves()
				except:
					percurves = [None]
			for c in listu:
				try:
					if splitmode == True and c != None:
						try:
							splits = dg.Geometry.Intersect(c,currentsurf)
						except:
							splits = []
							cex = dg.Geometry.Explode(c)
							for ce in cex:
								try:
									splits.append(dg.Geometry.Intersect(ce,currentsurf))
								except:
									splits.append(ce)
							splits = flatten(splits)
					elif splitmode == False and c != None:
						splits = [c]
					else:
						splits = []
				except:
					splits = []
				innercounter = 0
				wantall = []
				planarall = []
				goodsplits = []
				for s in splits:
					if splitmode == False:
						ptsnormalize = normalize(s.Length/(2*precision),True)
					else:
						ptsnormalize = normalize(2,True)
					point = []
					for ptsn in ptsnormalize:
						try:
							point.append(dg.Curve.PointAtParameter(s,ptsn))
						except:
							pass
					breakstatus = False
					for per in percurves:
						try:
							allstatus = []
							for popo in point:
								if doesinter(per,popo):
									allstatus.append(True)
								else:
									allstatus.append(False)
							if len(allstatus) == 0:
								allstatus.append(False)
							if all(allstatus):
								breakstatus = True
								break
						except:
							pass
					if breakstatus == True:
						innercounter += 1
						continue
					for popo in point:
						if doesinter(currentsurf,popo) and round(s.Length,1) != 0:
							goodsplits.append(splits[innercounter])
							break
					innercounter += 1
				try:
					if len(goodsplits) > 1:
						splitsjoin = [dg.PolyCurve.ByJoinedCurves(goodsplits)]
						testextend = dg.Curve.ExtendStart(splitsjoin[0],extendfix)
						splits = splitsjoin
					else:
						splits = goodsplits
				except:
					splits = goodsplits
				try:
					joinedsplits = joincurves(splits)
					splits = joinedsplits
				except:
					pass
				innercounter = 0
				for s in splits:
					split_start = splits[innercounter].StartPoint
					split_end = splits[innercounter].EndPoint
					doitstart = False
					doitend = False
					for per in percurves:
						try:
							if doesinter(per,split_start):
								doitstart = True
							if doesinter(per,split_end):
								doitend = True
							if doitstart == True and doitend == True:
								break
						except:
							pass
					try:
						if doitstart == True:
							extended = dg.Curve.ExtendStart(splits[innercounter],extendfix)
						else:
							extended = splits[innercounter]
						if doitend == True:
							extended = dg.Curve.ExtendEnd(extended,extendfix)
						else:
							pass
					except:
						extended = splits[innercounter]
						if doitstart == True or doitend == True:
							try:
								extended = exlines(splits[innercounter],extendfix,precision,doitstart,doitend)
							except:
								pass
					try:
						gridfunc = gridfunction(currentsurf,extended,precision,uwidth,udepth,isplanar)
						wantall.append(gridfunc[0])
						planarall.append(gridfunc[1])
					except:
						try:
							gridfunc = gridfunction(currentsurf,extended,3*precision,uwidth,udepth,isplanar)
							wantall.append(gridfunc[0])
							planarall.append(gridfunc[1])
						except:
							pass
					innercounter += 1
				tmp.append(wantall)
				planartmp.append(planarall)
		except:
			tmp.append([])
			planartmp.append([])
		splittedu.append(flatten(tmp))
		planaru.append(flatten(planartmp))
		counter += 1
	return splittedu,planaru

def surfacesubtract(surf,solids,isplanar=None):
	solids = tolist(solids)
	if isplanar != None:
		isplanar = tolist(isplanar)
		if all(isplanar) == True:
			try:
				tryunion = dg.Solid.ByUnion(solids)
				solids = [tryunion]
			except:
				pass
	result = []
	s = surf
	s = trysoliddif(s,solids)
	try:
		slistedexplode = dg.Geometry.Explode(s)
		inverse = dg.Surface.Difference(surf,slistedexplode)
	except:
		sfixed = []
		exploded = slistedexplode
		areas = []
		for i in exploded:
			areas.append(i.Area)
		maxarea = max(areas)
		counter = 0
		for a in areas:
			if maxarea == a:
				wantedsurf = exploded[counter]
				break
			counter += 1
		sfixed.append(wantedsurf)
		try:
			inverse = dg.Surface.Difference(surf,sfixed)
		except:
			inverse = None
	try:
		explodedS = dg.Geometry.Explode(s)
		areasS = []
		for i in explodedS:
			areasS.append(i.Area)
		maxarea = max(areasS)
		counter = 0
		for a in areasS:
			if maxarea == a:
				s = explodedS[counter]
				break
			counter += 1
	except:
		pass
	return s,inverse

def operateframes(surfs,bord,borw):
	subtractedlist = []
	inversedlist = []
	for s in surfs:
		try:
			already = False
			solidframe = framesv1(s,bord,borw)
			if solidframe == None:
				solidframe = framesv2(s,bord,borw)
				already = True
			subtract = surfacesubtract(s,solidframe)
			subtracted = subtract[0]
			inversed = subtract[1]
			subtractedlist.append(subtracted)
			inversedlist.append(inversed)
		except:
			try:
				if already == False:
					solidframe = framesv2(s,bord,borw)
					subtract = surfacesubtract(s,solidframe)
					subtracted = subtract[0]
					inversed = subtract[1]
					subtractedlist.append(subtracted)
					inversedlist.append(inversed)
				else:
					subtractedlist.append(s)
					inversedlist.append(None)
			except:
				try:
					solidframe = framesv3(s,bord,borw)
					sf = s
					for int in solidframe[1]:
						try:
							testifwork = dg.Surface.SubtractFrom(sf,int)
							if len(testifwork) != 0:
								sf = testifwork[0]
						except:
							pass
					subtractedlist.append(sf)
					inversedlist.append(solidframe[0])
				except:
					subtractedlist.append(s)
					inversedlist.append(None)
		try:
			solidframe.Dispose()
		except:
			pass
	return subtractedlist,inversedlist

def trythicken(poly,thickness,offset = 0):
	offsetpoly = tryoffset(poly,offset)
	try:
		solid = dg.Surface.Thicken(offsetpoly,thickness,True)
	except:
		solids = []
		extracted = dg.Geometry.Explode(poly)
		for e in extracted:
			e = tryoffset(e,offset)
			try:
				solids.append(dg.Surface.Thicken(e,thickness,True))
			except:
				try:
					permpan = dg.PolyCurve.ByJoinedCurves(e.PerimeterCurves())
					patchedpan = dg.Surface.ByPatch(permpan)
					solids.append(dg.Surface.Thicken(patchedpan,thickness,True))
					permpan.Dispose()
					patchedpan.Dispose()
				except:
					pass
		try:
			solid = dg.Solid.ByUnion(solids)
			for s in solids:
				s.Dispose()
		except:
			solid = solids
	return solid

def m_trythicken(chop,thickness,offset = 0):
	result = []
	for c in chop:
		result.append(trythicken(c,thickness,offset))
		c.Dispose()
	return result

def gridremover(gridsu,customgridsu):
	gridcounter = 0
	allgrids = []
	for eachfacegrid in gridsu:
		customface = customgridsu[gridcounter]
		goodgrid = []
		for grid in eachfacegrid:
			isgood = True
			for g in customface:
				try:
					if dg.Geometry.DoesIntersect(grid,g):
						isgood = False
						break
				except:
					pass
			if isgood == True:
				goodgrid.append(grid)
		if len(goodgrid) != 0:
			allgrids.append(goodgrid)
		else:
			allgrids.append([None])
		gridcounter += 1
	return allgrids

def gridcombine(solidu,soliducustom):
	listcounter = 0
	combinedlist = []
	for gridlist in solidu:
		customlist = soliducustom[listcounter]
		combinedlist.append(gridlist+customlist)
		listcounter += 1
	return combinedlist

def trysurfdif(surf,surfstovoid,thickness,is_sand=False):
	if is_sand == False:
		try:
			cleansurfstovoid = []
			for tov in surfstovoid:
				exploded = dg.Geometry.Explode(tov)
				if len(exploded) > 1:
					cleansurfstovoid.append(exploded)
				else:
					for exp in exploded:
						exp.Dispose()
					cleansurfstovoid.append(tov)
			surfstovoid = flatten(cleansurfstovoid)
			s = dg.Surface.Difference(surf,surfstovoid)
		except:
			thickened = []
			for su in surfstovoid:
				try:
					thickened.append(dg.Surface.Thicken(su,thickness,True))
				except:
					explodeme = dg.Geometry.Explode(su)
					for ex in explodeme:
						thickened.append(dg.Surface.Thicken(ex,thickness,True))
			s = surf
			for int in thickened:
				try:
					testifwork = dg.Surface.SubtractFrom(s,int)
					if len(testifwork) != 0:
						s = testifwork[0]
				except:
					pass
				int.Dispose()
	else:
		try:
			thickened = []
			for su in surfstovoid:
				try:
					thickened.append(dg.Surface.Thicken(su,thickness,True))
				except:
					explodeme = dg.Geometry.Explode(su)
					for ex in explodeme:
						thickened.append(dg.Surface.Thicken(ex,thickness,True))
			s = surf
			for int in thickened:
				try:
					testifwork = dg.Surface.SubtractFrom(s,int)
					if len(testifwork) != 0:
						s = testifwork[0]
				except:
					pass
				int.Dispose()
		except:
			cleansurfstovoid = []
			for tov in surfstovoid:
				exploded = dg.Geometry.Explode(tov)
				if len(exploded) > 1:
					cleansurfstovoid.append(exploded)
				else:
					for exp in exploded:
						exp.Dispose()
					cleansurfstovoid.append(tov)
			surfstovoid = flatten(cleansurfstovoid)
			s = dg.Surface.Difference(surf,surfstovoid)
	return s

def trysoliddif(surf,solidsstovoid):
	s = surf
	failed = []
	for int in solidsstovoid:
		try:
			testifwork = dg.Surface.SubtractFrom(s,int)
			if len(testifwork) != 0:
				s = testifwork[0]
			else:
				failed.append(int)
		except:
			failed.append(int)
	if len(failed) != 0:
		resfail = []
		for f in failed:
			resfail.append(dg.Geometry.Intersect(surf,f))
		resfail = flatten(resfail)
		try:
			for sone in resfail:
				s = dg.Surface.Difference(s,[sone])
		except:
			pass
	return s

def customgridoperate(gridsu,customgridsu,subtractedlist,inversedlist,borw,uwidth,safethickfactor,extendfix,removeconflict):
	if customgridsu != None:
		if removeconflict:
			gridsu =  gridremover(gridsu,customgridsu)
		sogu = solidgrids(subtractedlist,inversedlist,borw,gridsu,uwidth,safethickfactor,extendfix,True)
		solidu = sogu[0]
		sogupla = sogu[1]
		sogucus = solidgrids(subtractedlist,inversedlist,borw,customgridsu,uwidth,safethickfactor,extendfix,False)
		soliducustom = sogucus[0]
		soguplacus = sogucus[1]
		solidu = gridcombine(solidu,soliducustom)
		sogupla = gridcombine(sogupla,soguplacus)
	else:
		sogu = solidgrids(subtractedlist,inversedlist,borw,gridsu,uwidth,safethickfactor,extendfix,True)
		solidu = sogu[0]
		sogupla = sogu[1]
	return solidu,sogupla

def gridsurfaces(s,solidu,solidu_element,sogupla_element):
	if len(flatten(solidu)) != 0:
		ures = surfacesubtract(s,solidu_element,sogupla_element)
		for sol in solidu_element:
			sol.Dispose()
	else:
		ures = [None,None]
	return ures

def getexploded(usurfs,udepth,borw,offset = 0):
	if usurfs != False and usurfs != None:
		explodedusurfs = dg.Geometry.Explode(usurfs)
		allsolidu = []
		fixedexplodedusurfs = []
		for x in explodedusurfs:
			x = tryoffset(x,offset)
			if borw != 0:
				allsolidu.append(trythicken(x,udepth))
			else:
				allsolidu.append(x)
			fixedexplodedusurfs.append(x)
	else:
		allsolidu  =[]
		fixedexplodedusurfs = []
	return fixedexplodedusurfs,allsolidu

def tryoffset(surf,offset):
	try:
		if offset != 0:
			surf = dg.Surface.Offset(surf,offset)
	except:
		pass
	return surf

def tryunion(flattenedsolids):
	if len(flattenedsolids) > 1:
		solids = [x for x in flattenedsolids if x]
		if len(solids) > 1:
			pass
		else:
			return flattenedsolids
		unioned = [solids[0]]
		solids = solids[1:]
		for s in solids:
			i = 0
			unionDone = False
			while i < len(unioned):
				try:
					unioned[i] = unioned[i].Union(s)
					unionDone = True
					break
				except:	i += 1
			if not unionDone: unioned.append(s)
		try:
			for f in flattenedsolids:
				f.Dispose()
		except:
			pass
		return unioned
	else:
		return flattenedsolids

def safeversion():
	clr.AddReference("System.Windows.Forms")
	from System.Windows.Forms import Form,Label
	from System.Reflection import Assembly
	dynamo = Assembly.Load('DynamoCore')
	if dynamo.GetName().Version.MinorRevision == 4533:
		text = []
		text.append("ERROR: Dynamo Sandbox Version Unsupported")
		text.append("\nIt seems you have downloaded a Sandbox version number 2.11, it contains a bug and the script won't run.\n\nTo fix this issue please download newer version or contact Karam directly to advise you karam@aecedx.com")
		text = "\n".join(text)
		form = Form()
		form.Width = 600
		form.Height = 200
		label = Label()
		label.Text = text
		label.Width = 600
		label.Height = 600
		label.Parent = form	
		form.ShowDialog()
		return False
	return True

if safeversion():
	operate = operateframes(surfs,safethickfactor/2.0,borw)
	subtractedlist = operate[0]
	inversedlist = operate[1]
	initialgrids = initialgrids(subtractedlist,distanceU,distanceV,panmethodU,panmethodV,surfs)
	gridsu = initialgrids[0]
	gridsv = initialgrids[1]
	customopU = customgridoperate(gridsu,customgridsu,subtractedlist,inversedlist,borw,uwidth,safethickfactor,extendfix,removeconflict)
	solidu = customopU[0]
	sogupla = customopU[1]
	customopV = customgridoperate(gridsv,customgridsv,subtractedlist,inversedlist,borw,vwidth,safethickfactor,extendfix,removeconflict)
	solidv = customopV[0]
	sogvpla = customopV[1]
	
	sogw = solidgrids(subtractedlist,inversedlist,borw,customgridsw,wwidth,safethickfactor,extendfix,True)
	solidw = sogw[0]
	sogwpla = sogw[1]
		
	unionlist = []
	panelsublist = []
	laterpans = []
	counter = 0
	for s in subtractedlist:
		ures = gridsurfaces(s,solidu,solidu[counter],sogupla[counter])
		vres = gridsurfaces(s,solidv,solidv[counter],sogvpla[counter])
		wres = gridsurfaces(s,solidw,solidw[counter],sogwpla[counter])
		usurfs = ures[1]
		vsurfs = vres[1]
		wsurfs = wres[1]		
		joinedsolids = []
		allsolidu = []
		allsolidv = []
		allsolidw = []
		fixedexplodedusurfs = []
		fixedexplodedvsurfs = []
		fixedexplodedwsurfs = []
		status = False
		if udepth != vdepth or (udepth != wdepth and wsurfs != None) or (vdepth != wdepth and wsurfs != None) or uoffset != voffset or (uoffset != woffset and wsurfs != None) or (voffset != woffset and wsurfs != None):
			status = "DifferentUV"
			explodeopU = getexploded(usurfs,udepth,borw,uoffset)
			fixedexplodedusurfs = explodeopU[0]
			allsolidu = explodeopU[1]
			explodeopV = getexploded(vsurfs,vdepth,borw,voffset)
			fixedexplodedvsurfs = explodeopV[0]
			allsolidv = explodeopV[1]
			explodeopW = getexploded(wsurfs,wdepth,borw,woffset)
			fixedexplodedwsurfs = explodeopW[0]
			allsolidw = explodeopW[1]				
			allexploded = fixedexplodedusurfs + fixedexplodedvsurfs + fixedexplodedwsurfs
		else:
			status = "SameUV"
			allexploded = joinsurfs([usurfs,vsurfs,wsurfs])
			joinedsolids = []
			#if borw != 0:
			#	joinedsolids = multithreadrun2inputs(allexploded,m_trythicken,udepth,uoffset)
			#else:
			#	for expo in allexploded:
			#		joinedsolids.append(expo)
			for expo in allexploded:
				if borw != 0:
					try:
						joinedsolids.append(trythicken(expo,udepth,uoffset))
					except:
						pass
				else:
					joinedsolids.append(expo)
			allexploded = [x for x in allexploded if x]
		if len(allexploded) != 0 and borw != 0 and createpanels == True:
			panelsub = trysurfdif(s,allexploded,mindepth,True)
			explodedpan = dg.Geometry.Explode(panelsub)
			tmp = []
			#tmp = multithreadrun2inputs(explodedpan,m_trythicken,panelthickness,panelsoffset)
			for ep in explodedpan:
				tmp.append(trythicken(ep,panelthickness,panelsoffset))
				ep.Dispose()
			panelsublist.append(tmp)
		elif len(allexploded) != 0 and borw == 0 and createpanels == True:
			panelsub = trysurfdif(s,allexploded,mindepth,True)
			explodedpan = dg.Geometry.Explode(panelsub)
			for ep in explodedpan:
				laterpans.append(ep)
		elif createpanels == True:
			panelsublist.append(trythicken(s,panelthickness,panelsoffset))
		if len(allsolidu) != 0 or len(allsolidv) != 0 or len(allsolidw) != 0:
			if borw != 0:
				joinedsolids = allsolidu + allsolidv + allsolidw
			else:
				joinedsolids = [allsolidu] + [allsolidv] + [allsolidw]
		if len(joinedsolids) != 0 and len(joinedsolids) > 1:
			try:
				if borw != 0:
					unioned = dg.Solid.ByUnion(joinedsolids)
					for j in joinedsolids:
						j.Dispose()
				else:
					unioned = joinedsolids
			except:
				unioned = joinedsolids
			unionlist.append(unioned)
		elif len(joinedsolids) != 0:
			unioned = joinedsolids[0]
			unionlist.append(unioned)
		else:
			unionlist.append(None)
		counter += 1
	fixedinvertedlist = []
	for inv in inversedlist:
		if inv != None:
			fixedinvertedlist.append(dg.Geometry.Explode(inv))
	thickframes = []
	if len(fixedinvertedlist) != 0:
		fixedinvertedlist = flatten(fixedinvertedlist)
		joinedframes = joinsurfs(fixedinvertedlist)
		#thickframes = multithreadrun2inputs(joinedframes,m_trythicken,bord,frameoffset)
		for joi in joinedframes:
			try:
				thickframes.append(trythicken(joi,bord,frameoffset))
			except:
				pass
			joi.Dispose()
		for fi in fixedinvertedlist:
			fi.Dispose()
	if borw == 0 and len(laterpans) != 0 and createpanels == True:
		joinedall = joinsurfs(laterpans)
		#panelsublist = multithreadrun2inputs(joinedall,m_trythicken,panelthickness,panelsoffset)
		for jall in joinedall:
			panelsublist.append(trythicken(jall,panelthickness,panelsoffset))
			jall.Dispose()
		for l in laterpans:
			l.Dispose()
	if borw == 0:
		if status == "DifferentUV":
			unionresult = []
			transposed = list(map(list, zip(*unionlist)))
			uslist = joinsurfs(flatten(transposed[0]))
			vslist = joinsurfs(flatten(transposed[1]))
			wslist = joinsurfs(flatten(transposed[2]))
			solids = []
			#solids.append(multithreadrun2inputs(uslist,m_trythicken,udepth,uoffset))
			#solids.append(multithreadrun2inputs(vslist,m_trythicken,vdepth,voffset))
			#solids.append(multithreadrun2inputs(wslist,m_trythicken,wdepth,woffset))
			for us in uslist:
				solids.append(trythicken(us,udepth,uoffset))
			for vs in vslist:
				solids.append(trythicken(vs,vdepth,voffset))
			for ws in wslist:
				solids.append(trythicken(ws,wdepth,woffset))
			flattenedsolids = flatten(solids)
			unionresult = tryunion(flattenedsolids)
		elif status == "SameUV":
			allexploded = joinsurfs(flatten(unionlist))
			unionresult = []
			#unionresult = multithreadrun2inputs(allexploded,m_trythicken,udepth,uoffset)
			for expo in allexploded:
				try:
					unionresult.append(trythicken(expo,udepth,uoffset))
				except:
					pass
		else:
			unionresult = []		
	else:
		unionresult = unionlist
	OUT = unionresult,panelsublist,thickframes
else:
	OUT = [None],[None],[None]
# ----------------------------------------
VAROutput = Output(python_script)
