# Dynamo custom node K-Pattern Family.dyf (Dynamo 2.1.0.7500)
# category: Synthesize.Automate.Family
# K-Pattern Family

VARFamilyInstance = Input(VARFamilyInstance: var[]..[])
VARInitialHostWidth = Input(VARInitialHostWidth: double = 0)
VARFamilyTemplateGenericModels = Input(VARFamilyTemplateGenericModels: var[]..[])
VARFamilyTemplateAdaptive = Input(VARFamilyTemplateAdaptive: var[]..[])
VARFamilyTemplatePattern = Input(VARFamilyTemplatePattern: var[]..[])
VARExtraLength = Input(VARExtraLength: double = 0)
VARExtraDepth = Input(VARExtraDepth: double = 0)
VARSafeHeight = Input(VARSafeHeight: double = 0)
python_script = Python(IN[0]=VARFamilyInstance, IN[1]=VARInitialHostWidth, IN[2]=VARFamilyTemplateGenericModels, IN[3]=VARFamilyTemplateAdaptive, IN[4]=VARFamilyTemplatePattern, IN[5]=VARExtraLength, IN[6]=VARExtraDepth, IN[7]=VARSafeHeight)
# ---------- python_script.python (1679 lines) ----------
# Proudly created by Karam Baki: karam@aecedx.com

# Import crl
import clr

# IMPORTANT : ALL DYNAMO DESIGN SCRIPT NODES ARE AS (dg)
clr.AddReference('ProtoGeometry')
from Autodesk.DesignScript import Geometry as dg

# Enable Revit API
clr.AddReference('RevitAPI')
from Autodesk.Revit.DB import *

# Enable ToDSType
clr.AddReference('RevitNodes')
import Revit

# Enable Geometry Conversion Methods
clr.ImportExtensions(Revit.GeometryConversion)

# Enable DocumentManager and TransactionManager
clr.AddReference('RevitServices')
from RevitServices.Persistence import DocumentManager
from RevitServices.Transactions import TransactionManager

# Enable Revit UI
clr.AddReference("RevitAPIUI")
from Autodesk.Revit.UI import TaskDialog

# Import os
clr.AddReference("System")
import System
import sys
from System.Collections.Generic import *
pf_path = System.Environment.GetFolderPath(System.Environment.SpecialFolder.ProgramFilesX86)
sys.path.append('%s\IronPython 2.7\Lib' %pf_path)
import os
import traceback
import random
import string
import re

# Family Load Options Class
class FamOpt1(IFamilyLoadOptions):
	def __init__(self):
		pass
	def OnFamilyFound(self,familyInUse, overwriteParameterValues):
		overwriteParameterValues.Value = True
		return True
	def OnSharedFamilyFound(self,familyInUse, source, overwriteParameterValues):
		overwriteParameterValues.Value = True
		return True

# Family Load Options Class - Without Overwriting Parameters
class FamOptWithout(IFamilyLoadOptions):
	def __init__(self):
		pass
	def OnFamilyFound(self,familyInUse, overwriteParameterValues):
		overwriteParameterValues.Value = False
		return True
	def OnSharedFamilyFound(self,familyInUse, source, overwriteParameterValues):
		overwriteParameterValues.Value = False
		return True

# Simple Warning Swallow Class
class WarnSwallowSimple(IFailuresPreprocessor):
	def PreprocessFailures(self, failuresAccessor):
		failuresAccessor.DeleteAllWarnings()
		return FailureProcessingResult.Continue

def docunique(doc,myList):
	tmplist = []
	for m in myList:
		if m != "":
			tmplist.append(m)
	myList = tmplist
	uniqueList = []
	for item in myList :
		itemExist = False
		for x in uniqueList :
			if x == item :
				itemExist = True
				break
		if not itemExist :
			uniqueList.append(item)
	elemunique = []
	for un in uniqueList:
		elemunique.append(doc.GetElement(un))
	return elemunique

# Deactivate Refernce Lines
def batchdeactivaterefs(doc):
	TransactionManager.Instance.ForceCloseTransaction()
	trans1 = Transaction(doc, 'Deactivating Reference Lines')
	trans1.Start()
	warnhandle = WarnSwallowSimple()
	foptions = trans1.GetFailureHandlingOptions()
	foptions.SetFailuresPreprocessor(warnhandle)
	trans1.SetFailureHandlingOptions(foptions)
	try:
		reflines = [x for x in FilteredElementCollector(doc).OfClass(CurveElement).ToElements() if x.IsReferenceLine]
		for r in reflines:
			try:
				param = r.LookupParameter("Reference")
				current = param.AsInteger()
				if current != 0:
					param.Set(0)
			except:
				pass
		trans1.Commit()
		return True
	except:
		trans1.Commit()
		return False

def hasnested(doc):
	result = [x for x in FilteredElementCollector(doc).OfClass(FamilyInstance).ToElements()]
	if len(result) != 0:
		return True,result
	else:
		return False,[]

def refmainOP(doc):
	hasnest = hasnested(doc)
	if hasnest[0]:
		families = []
		for r in hasnest[1]:
			families.append(r.Symbol.Family.Id)
		families = docunique(doc,families)
		for f in families:
			famdoc = doc.EditFamily(f)
			batchdeactivaterefs(famdoc)
			refLoopOP(famdoc)
			famdoc.LoadFamily(doc,FamOptWithout())
			famdoc.Close(False)
	return True

def refLoopOP(doc):
	hasnest = hasnested(doc)
	if hasnest[0]:
		families = []
		for r in hasnest[1]:
			families.append(r.Symbol.Family.Id)
		families = docunique(doc,families)
		for f in families:
			famdoc = doc.EditFamily(f)
			batchdeactivaterefs(famdoc)
			refmainOP(famdoc)
			famdoc.LoadFamily(doc,FamOptWithout())
			famdoc.Close(False)
	return True

# Transfer Document Units
def transferunit(doc,famdoc):
	if int(DocumentManager.Instance.CurrentUIApplication.Application.VersionNumber) < 2021:
		unit = famdoc.GetUnits()
		currectformat = doc.GetUnits().GetFormatOptions(UnitType.UT_Length)
		accuracy = currectformat.Accuracy
		unit.SetFormatOptions(UnitType.UT_Length,FormatOptions(currectformat.DisplayUnits,accuracy))
		famdoc.SetUnits(unit)
	else:
		unit = famdoc.GetUnits()
		currectformat = doc.GetUnits().GetFormatOptions(SpecTypeId.Length)
		unit.SetFormatOptions(SpecTypeId.Length,currectformat)
		famdoc.SetUnits(unit)

# Deactivate Refernce Lines
def deactivaterefs(doc):
	try:
		reflines = [x for x in FilteredElementCollector(doc).OfClass(CurveElement).ToElements() if x.IsReferenceLine]
		for r in reflines:
			try:
				param = r.LookupParameter("Reference")
				current = param.AsInteger()
				if current != 0:
					param.Set(0)
			except:
				pass
		return True
	except:
		return False

# Detect Upper Mid Point
def midupperpoint(doc,elem):
	doc.Regenerate()
	bbox = elem.get_BoundingBox(None)
	minp = bbox.Min.ToPoint()
	maxp = bbox.Max.ToPoint()
	fixedminp = dg.Point.ByCoordinates(minp.X,minp.Y,maxp.Z)
	midP = dg.Curve.PointAtParameter(dg.Line.ByStartPointEndPoint(maxp,fixedminp),0.5)
	return midP

# Detect Upper Mid Point
def middownerpoint(doc,elem):
	doc.Regenerate()
	bbox = elem.get_BoundingBox(None)
	minp = bbox.Min.ToPoint()
	maxp = bbox.Max.ToPoint()
	fixedmaxp = dg.Point.ByCoordinates(maxp.X,maxp.Y,minp.Z)
	midP = dg.Curve.PointAtParameter(dg.Line.ByStartPointEndPoint(fixedmaxp,minp),0.5)
	return midP

# Dump External Definition Create
def exdef(param_name,param_guid,param_type,uiapp):
	app = uiapp.Application
	originalfile = uiapp.Application.SharedParametersFilename
	temp_path = System.IO.Path.GetTempPath()
	temp_file = temp_path + "Karam_Temp_Shared.txt"
	open(temp_file, 'a').close()
	uiapp.Application.SharedParametersFilename = temp_file
	definition_file = app.OpenSharedParameterFile()
	try:
		definition_file.Groups.Create("Karam Group")
	except:
		pass
	definition_groups = definition_file.Groups
	for group in definition_groups:
		ops = ExternalDefinitionCreationOptions(param_name, param_type)
		ops.GUID = param_guid
		try:
			group.Definitions.Create(ops)
		except:
			pass
	exdef = list(list(definition_groups)[0].Definitions)[0]
	return exdef,originalfile,temp_file

# Draw Invisible Line If Needed
def invline(doc,elem,autoheight,distance):
	if autoheight:
		p1 = midupperpoint(doc,elem)
		p1 = dg.Point.ByCoordinates(p1.X,p1.Y,p1.Z + distance/2.0)
		p2 = middownerpoint(doc,elem)
		p2 = dg.Point.ByCoordinates(p2.X,p2.Y,p2.Z - distance/2.0)
	else:
		p1 = midupperpoint(doc,elem)
		p2 = dg.Point.ByCoordinates(p1.X,p1.Y,distance/2.0)
		p1 = dg.Point.ByCoordinates(p1.X,p1.Y,-distance/2.0)
	revitline = Line.CreateBound(p1.ToXyz(),p2.ToXyz())
	tmp_plane = dg.Plane.ByOriginNormal(p1,dg.Vector.XAxis())
	skp = SketchPlane.Create(doc,tmp_plane.ToPlane())
	modline = doc.FamilyCreate.NewModelCurve(revitline,skp)
	modline.LineStyle = [x for x in FilteredElementCollector(doc).OfClass(GraphicsStyle) if x.Name.lower() == "<invisible lines>"][0]
	return modline

# Simple Flatten
def flatten(x):
    result = []
    for el in x:
        if hasattr(el, "__iter__") and not isinstance(el, basestring):
            result.extend(flatten(el))
        else:
            result.append(el)
    return result

# Get Maximum Height In Family
def maxfamheight(projectdoc,famdoc,autoheight = True,safeheight = 0):
	if autoheight or safeheight == 0:
		elements = []
		collector = FilteredElementCollector(famdoc).WhereElementIsNotElementType().ToElements()
		opt = Options()
		for c in collector:
			if (c.get_Parameter(BuiltInParameter.IS_VISIBLE_PARAM) or c.get_Parameter(BuiltInParameter.ELEMENT_IS_CUTTING)) and "line" not in c.ToString().lower() and "region" not in c.ToString().lower() and "curve" not in c.ToString().lower():
				try:
					if c.get_Parameter(BuiltInParameter.IS_VISIBLE_PARAM).AsInteger() == 0:
						continue
				except:
					pass
				try:
					status = c.get_Parameter(BuiltInParameter.ELEMENT_IS_CUTTING).AsInteger()
					if status == 0:
						elements.append(c)
				except:
					elements.append(c)
		if famdoc.OwnerFamily.get_Parameter(BuiltInParameter.FAMILY_HOSTING_BEHAVIOR).AsValueString() == "Face":
			count = 0
			for e in elements:
				if e.ToString() == "Autodesk.Revit.DB.Extrusion":
					elements.pop(count)
					break
				count += 1
		result = []
		minpts = []
		maxpts = []
		pts = []
		pX = []
		pY = []
		pZ = []
		for e in elements:
			try:
				bb = e.get_BoundingBox(None)
				minp = bb.Min
				maxp = bb.Max
				tmpP = []
				tmpP.append(minp)
				tmpP.append(maxp)
				pts.append(tmpP)
				for p in tmpP:
					pX.append(p.X)
					pY.append(p.Y)
					pZ.append(p.Z)
			except:
				pass
		MAX_X = max(pX)
		MAX_Y = max(pY)
		MAX_Z = max(pZ)
		MIN_Z = min(pZ)
		p1 = XYZ(MAX_X,MAX_Y,MAX_Z)
		p2 = XYZ(MAX_X,MAX_Y,MIN_Z)
		distance = p2.DistanceTo(p1)
		if safeheight != 0:
			if int(DocumentManager.Instance.CurrentUIApplication.Application.VersionNumber) < 2021:
				safeheight = UnitUtils.ConvertToInternalUnits(safeheight,projectdoc.GetUnits().GetFormatOptions(UnitType.UT_Length).DisplayUnits)
			else:
				safeheight = UnitUtils.ConvertToInternalUnits(safeheight,projectdoc.GetUnits().GetFormatOptions(SpecTypeId.Length).GetUnitTypeId())
			return distance + safeheight
		else:
			return distance
	else:
		if int(DocumentManager.Instance.CurrentUIApplication.Application.VersionNumber) < 2021:
			distance = UnitUtils.ConvertToInternalUnits(safeheight,projectdoc.GetUnits().GetFormatOptions(UnitType.UT_Length).DisplayUnits)
		else:
			distance = UnitUtils.ConvertToInternalUnits(safeheight,projectdoc.GetUnits().GetFormatOptions(SpecTypeId.Length).GetUnitTypeId())
		return distance

# Get Family Instance Information
def getinstanceinfo(sourceinstance):
	family = sourceinstance.Symbol.Family
	familyname = family.Name
	famtype = sourceinstance.Symbol
	famtypename = sourceinstance.Symbol.GetParameters("Type Name")[0].AsString()
	return family,familyname,famtype,famtypename

# Get ElementId or Value String
def bestparamvalue(famdoc,famtype,famparam):
	if famdoc == None and famtype == None:
		ParamValueString = famparam.AsElementId()
		if ParamValueString.ToString() == "-1":
			storagetype = str(famparam.StorageType)
			try:
				if storagetype == "Integer":
					ParamValueString = famparam.AsInteger()
				elif storagetype == "Double":
					ParamValueString = famparam.AsDouble()
				elif storagetype == "String":
					ParamValueString = famparam.AsString()
			except:
				ParamValueString = famparam.AsValueString()
		else:
			try:
				ParamValueString = famparam.AsValueString()
			except:
				ParamValueString = None
	else:
		ParamValueString = famtype.AsElementId(famparam)
		if ParamValueString.ToString() == "-1":
			storagetype = str(famparam.StorageType)
			try:
				if storagetype == "Integer":
					ParamValueString = famtype.AsInteger(famparam)
				elif storagetype == "Double":
					ParamValueString = famtype.AsDouble(famparam)
				elif storagetype == "String":
					ParamValueString = famtype.AsString(famparam)
			except:
				ParamValueString = famtype.AsValueString(famparam)
		else:
			try:
				if famdoc != None:
					ParamValueString = famdoc.GetElement(ParamValueString).Name
				else:
					ParamValueString = famtype.AsValueString(famparam)
			except:
				ParamValueString = famtype.AsValueString(famparam)
	return ParamValueString

# Get/Create Wanted Family Type
def getfamtype(famdoc,famtypename = None):
	alltypes = famdoc.FamilyManager.Types
	if len(list(alltypes)) == 1 or famtypename == None:
		famtype = famdoc.FamilyManager.CurrentType
	elif len(list(alltypes)) == 0 or famtypename == None:
		famtype = famdoc.FamilyManager.NewType(famtypename)
		famdoc.FamilyManager.CurrentType = famtype
	else:
		for t in alltypes:
			if t.Name == famtypename:
				famdoc.FamilyManager.CurrentType = t
				famtype = t
				break
	return famtype

# Get Batch Family Parameters Information Function
def famparaminfo(famparam,famdoc,famtype = None,toconsiderinfo = None):
	if famtype == None:
		famtype = famdoc.FamilyManager.CurrentType
	ParamName = famparam.Definition.Name
	if toconsiderinfo != None:
		for tocon in toconsiderinfo:
			if tocon[0] == ParamName:
				try:
					famdoc.FamilyManager.Set(famparam,tocon[1])
				except:
					try:
						famdoc.FamilyManager.SetValueString(famparam,tocon[1])
					except:
						pass
	is_shared = famparam.IsShared
	#if ParamName == "Height":
	#	ParamName = "Height_Original"
	ParamValueString = bestparamvalue(famdoc,famtype,famparam)
	if ParamValueString == None:
		try:
			ParamValueString = famtype.AsString(famparam)
		except:
			pass
	ParamType = famparam.Definition.ParameterType
	BuiltinParam = famparam.Definition.BuiltInParameter
	BuiltinGroup = famparam.Definition.ParameterGroup
	is_instance = famparam.IsInstance
	if is_shared:
		guid = famparam.GUID
	else:
		guid = None
	formula = famparam.Formula
	if formula == None:
		is_formuladefined = False
	else:
		is_formuladefined = True
	if len(list(famparam.AssociatedParameters)):
		is_associated = True
	else:
		is_associated = False
	return famparam,ParamValueString,ParamName,ParamType,BuiltinParam,BuiltinGroup,is_instance,is_shared,guid,formula,is_formuladefined,is_associated

# Get Batch Family Parameter Information
def getparaminfo(projectdoc,famdoc,famtype = None,toconsiderinfo = None,autoheight = True,safeheight = 0):
	if famtype == None:
		famtype = famdoc.FamilyManager.CurrentType
	allparams = list(famdoc.FamilyManager.GetParameters())
	info= []
	for famparam in allparams:
		batchinfo = famparaminfo(famparam,famdoc,famtype,toconsiderinfo)
		if str(batchinfo[3]) != "LoadClassification":
			info.append(batchinfo)
	tochecklater = []
	for i in info:
		if i[9] != None:
			splitted = i[9].Split(" ")
			tochecklater.append(splitted)
	tochecklater = flatten(tochecklater)
	important = []
	for i in info:
		name = i[2]
		if name in tochecklater or i[7] == True or i[3].ToString() == "Material":
			important.append(True)
		else:
			important.append(False)
	newinfo = []
	count = 0
	for im in important:
		currentinfo = info[count]
		count += 1
		tmp = []
		if im:
			if currentinfo[9] == None:
				#status = "Normal Importance"
				status = True
			else:
				#status = "Delayed Importance"
				status = True
			for i in currentinfo:
				tmp.append(i)
			tmp.append(status)
		else:
			for i in currentinfo:
				tmp.append(i)
			tmp.append(False)
		newinfo.append(tmp)
	count = 0
	maxheight = maxfamheight(projectdoc,famdoc,autoheight,safeheight)
	for i in newinfo:
		if i[2] == "Height" and i[4].ToString() == "RENDER_PLANT_HEIGHT":
			famdoc.FamilyManager.Set(i[0],maxheight)
			newinfo[count][1] = famtype.AsDouble(i[0])
			break
		count += 1
	try: isfam_shared = famdoc.OwnerFamily.get_Parameter(BuiltInParameter.FAMILY_SHARED).AsInteger()
	except: isfam_shared = 0
	try: isfam_workplane = famdoc.OwnerFamily.get_Parameter(BuiltInParameter.FAMILY_WORK_PLANE_BASED).AsInteger()
	except: isfam_workplane = 0
	try: isfam_vertical = famdoc.OwnerFamily.get_Parameter(BuiltInParameter.FAMILY_ALWAYS_VERTICAL).AsInteger()
	except: isfam_vertical = 0
	try: isfam_cuts = famdoc.OwnerFamily.get_Parameter(BuiltInParameter.FAMILY_ALLOW_CUT_WITH_VOIDS).AsInteger()
	except: isfam_cuts = 0
	famdoc.OwnerFamily.get_Parameter(BuiltInParameter.FAMILY_SHARED).Set(0)
	return newinfo,isfam_shared,isfam_workplane,isfam_vertical,isfam_cuts,maxheight

# Initial Family Instance Information
def initialop(projectdoc,sourceinstance,hostwidth,autoheight,safeheight):
	initialinfo = getinstanceinfo(sourceinstance)
	family = initialinfo[0]
	familyname = initialinfo[1]
	projectfamtype = initialinfo[2]
	famtypename = initialinfo[3]
	instanceparameters = sourceinstance.GetOrderedParameters()
	namesandvalues = []
	for ins in  instanceparameters:
		namesandvalues.append([ins.Definition.Name,bestparamvalue(None,None,ins)])
	TransactionManager.Instance.ForceCloseTransaction()
	famdoc = projectdoc.EditFamily(family)
	#refmainOP(famdoc)
	trans1 = Transaction(famdoc, 'Set Initial Height Parameter')
	trans1.Start()
	warnhandle = WarnSwallowSimple()
	foptions = trans1.GetFailureHandlingOptions()
	foptions.SetFailuresPreprocessor(warnhandle)
	trans1.SetFailureHandlingOptions(foptions)
	#deactivaterefs(famdoc)
	if famdoc.OwnerFamily.get_Parameter(BuiltInParameter.FAMILY_HOSTING_BEHAVIOR).AsValueString() == "Ceiling":
		isceiling = True
	else:
		isceiling = False
	if hostwidth != 0:
		try:
			all_walls = list(FilteredElementCollector(famdoc).OfCategory(BuiltInCategory.OST_Walls).WhereElementIsElementType())
			all_floors = list(FilteredElementCollector(famdoc).OfCategory(BuiltInCategory.OST_Floors).WhereElementIsElementType())
			all_roofs = list(FilteredElementCollector(famdoc).OfCategory(BuiltInCategory.OST_Roofs).WhereElementIsElementType())
			all_ceilings = list(FilteredElementCollector(famdoc).OfCategory(BuiltInCategory.OST_Ceilings).WhereElementIsElementType())
			host_types = all_walls + all_floors + all_roofs + all_ceilings
			thecompound = CompoundStructure.CreateSingleLayerCompoundStructure(MaterialFunctionAssignment.Structure,hostwidth,FilteredElementCollector(famdoc).OfClass(Material).FirstElementId())
			for host_type in host_types:
				host_type.SetCompoundStructure(thecompound)
		except:
			pass
	try:
		twolevelheight = projectdoc.GetElement(sourceinstance.get_Parameter(BuiltInParameter.FAMILY_TOP_LEVEL_PARAM).AsElementId()).Elevation - projectdoc.GetElement(sourceinstance.get_Parameter(BuiltInParameter.FAMILY_BASE_LEVEL_PARAM).AsElementId()).Elevation + sourceinstance.get_Parameter(BuiltInParameter.FAMILY_TOP_LEVEL_OFFSET_PARAM).AsDouble() - sourceinstance.get_Parameter(BuiltInParameter.FAMILY_BASE_LEVEL_OFFSET_PARAM).AsDouble()
		all_levels = list(FilteredElementCollector(famdoc).OfCategory(BuiltInCategory.OST_Levels).WhereElementIsNotElementType())
		if twolevelheight != None and len(all_levels) > 1:
			all_levels[-1].Elevation = twolevelheight
	except:
		pass
	originalcat = famdoc.OwnerFamily.FamilyCategory.Name
	famtype = getfamtype(famdoc,famtypename)
	allinfo = getparaminfo(projectdoc,famdoc,famtype,namesandvalues,autoheight,safeheight)
	trans1.Commit()
	paraminfo = allinfo[0]
	isfam_shared = allinfo[1]
	isfam_workplane = allinfo[2]
	isfam_vertical = allinfo[3]
	isfam_cuts = allinfo[4]
	maxheight = allinfo[5]
	typemark = projectfamtype.get_Parameter(BuiltInParameter.ALL_MODEL_TYPE_MARK).AsString()
	resultname = "K-Rigged" + separator + familyname + separator + famtypename
	return resultname,famdoc,paraminfo,isfam_shared,isfam_workplane,isfam_vertical,isfam_cuts,maxheight,originalcat,famtypename,typemark,isceiling

# Create New Family
def createfamily(fam_path,doc,uiapp,famname,famcategory,isShared,isWorkplane,isVertical,isCuts,maxheight,paraminfo,instance,initial):
	save_path = '%s%s.rfa' % (temp_path, re.sub(r'[\\/*?:"<>|]',"",famname))
	famdoc = doc.Application.NewFamilyDocument(fam_path)
	try:
		TransactionManager.Instance.ForceCloseTransaction()
		trans1 = Transaction(famdoc, 'New ' + famname + ' Family')
		trans1.Start()
		warnhandle = WarnSwallowSimple()
		foptions = trans1.GetFailureHandlingOptions()
		foptions.SetFailuresPreprocessor(warnhandle)
		trans1.SetFailureHandlingOptions(foptions)
		fam_cat = famdoc.Settings.Categories.get_Item(famcategory)
		famdoc.OwnerFamily.FamilyCategory = fam_cat
		try:
			famtype = famdoc.FamilyManager.NewType(famname)
			famdoc.FamilyManager.CurrentType = famtype
		except:
			pass
		for p in paraminfo:
			try:
				if p[2] != "Height_Scale":
					instatus = p[6]
				else:
					instatus = instance
				if p[7] == True:
					externaldefOP = exdef(p[2],p[8],p[3],uiapp)
					externaldef = externaldefOP[0]
					try:
						freshparam = famdoc.FamilyManager.AddParameter(externaldef,p[5],instatus)
					except:
						pass
					uiapp.Application.SharedParametersFilename = externaldefOP[1]
					os.remove(externaldefOP[2])
				else:
					freshparam = famdoc.FamilyManager.AddParameter(p[2],p[5],p[3],instatus)
			except:
				pass
			if p[2] == "Height" and (initial == "First" or initial == "Second"):
				freshparam = famdoc.FamilyManager.AddParameter("Height_Original",p[5],p[3],p[6])
				if p[1] != None:
					famdoc.FamilyManager.Set(freshparam,p[1])
		if famcategory != "Planting":
			try:
				famdoc.FamilyManager.AddParameter("Height_Scale",BuiltInParameterGroup.PG_GEOMETRY,ParameterType.Length,instance)
			except:
				pass
		parms = famdoc.FamilyManager.GetParameters()
		for epms in parms:
			pname = epms.Definition.Name
			if (pname == "Height" and famcategory == "Planting") or pname == "Height_Scale":
				famdoc.FamilyManager.Set(epms, maxheight)
		if isShared == True:
			try:famdoc.OwnerFamily.get_Parameter(BuiltInParameter.FAMILY_SHARED).Set(1)
			except:pass
		else:
			try:famdoc.OwnerFamily.get_Parameter(BuiltInParameter.FAMILY_SHARED).Set(0)
			except:pass
		if isWorkplane == True:
			try:famdoc.OwnerFamily.get_Parameter(BuiltInParameter.FAMILY_WORK_PLANE_BASED).Set(1)
			except:pass
		else:
			try:famdoc.OwnerFamily.get_Parameter(BuiltInParameter.FAMILY_WORK_PLANE_BASED).Set(0)
			except:pass
		if isVertical == True:
			try:famdoc.OwnerFamily.get_Parameter(BuiltInParameter.FAMILY_ALWAYS_VERTICAL).Set(1)
			except:pass
		else:
			try:famdoc.OwnerFamily.get_Parameter(BuiltInParameter.FAMILY_ALWAYS_VERTICAL).Set(0)
			except:pass
		if isCuts == True:
			try:famdoc.OwnerFamily.get_Parameter(BuiltInParameter.FAMILY_ALLOW_CUT_WITH_VOIDS).Set(1)
			except:pass
		else:
			try:famdoc.OwnerFamily.get_Parameter(BuiltInParameter.FAMILY_ALLOW_CUT_WITH_VOIDS).Set(0)
			except:pass
		trans1.Commit()
		famdoc.SaveAs(save_path, SaveAsOpt)
		loaded = famdoc
	except:
		try:
			trans1.Commit()
		except:
			pass
		TransactionManager.Instance.ForceCloseTransaction()
		try:famdoc.Close(False)
		except:pass
		try:doc.Close(False)
		except:pass
		try:System.IO.File.Delete(save_path)
		except:pass
		loaded = None
	return loaded,save_path

# Load Family
def loadOP(famdoc,doc,save_path,famtypename,paraminfo,initial,forceworkplane,isceiling,autoheight,safeheight):
	try:
		if famdoc != None and doc != None:
			loaded = famdoc.LoadFamily(doc,FamOpt1())
			symbols = loaded.GetFamilySymbolIds().GetEnumerator()
			if famtypename != None:
				for t in symbols:
					telem = doc.GetElement(t)
					typename = telem.GetParameters("Type Name")[0].AsString()
					if typename == famtypename:
						symbol1 = doc.GetElement(t)
			else:
				symbols.MoveNext()
				symbol1 = doc.GetElement(symbols.Current)
			TransactionManager.Instance.ForceCloseTransaction()
			trans1 = Transaction(doc, 'Placing Family')
			trans1.Start()
			warnhandle = WarnSwallowSimple()
			foptions = trans1.GetFailureHandlingOptions()
			foptions.SetFailuresPreprocessor(warnhandle)
			trans1.SetFailureHandlingOptions(foptions)
			if forceworkplane == True and ((initial == "Second" and isceiling) or initial == "Last"):
				try:doc.OwnerFamily.get_Parameter(BuiltInParameter.FAMILY_WORK_PLANE_BASED).Set(1)
				except:pass
			if forceworkplane == True and initial == "Last":
				try:doc.OwnerFamily.get_Parameter(BuiltInParameter.FAMILY_ALWAYS_VERTICAL).Set(0)
				except:pass
			if not symbol1.IsActive: symbol1.Activate()
			newlyplaced = False
			try:
				if forceworkplane == True and (initial == "Last"):
					firstlevel = doc.GetElement(FilteredElementCollector(doc).OfCategory(BuiltInCategory.OST_Levels).WhereElementIsNotElementType().FirstElementId())
					newinstace = doc.FamilyCreate.NewFamilyInstance(Reference(firstlevel), XYZ.Zero, XYZ.Zero, symbol1)
				else:
					newinstace = doc.FamilyCreate.NewFamilyInstance(XYZ.Zero, symbol1, Structure.StructuralType.NonStructural)
				newlyplaced = True
			except:
				try:
					firstlevel = doc.GetElement(FilteredElementCollector(doc).OfCategory(BuiltInCategory.OST_Levels).WhereElementIsNotElementType().FirstElementId())
					newinstace = doc.FamilyCreate.NewFamilyInstance(XYZ.Zero, symbol1, firstlevel, Structure.StructuralType.NonStructural)
				except:
					newinstace = doc.GetElement(FilteredElementCollector(doc).OfCategoryId(symbol1.Category.Id).WhereElementIsNotElementType().FirstElementId())
				newlyplaced = True
			if forceworkplane == True and newlyplaced and initial == "Second":
				newinstace.Location.Point = XYZ(0,0,0)
				doc.Regenerate()
				newpoint = midbottompointreversed(newinstace)
				newX = newpoint.X
				newY = newpoint.Y
				existedP = newinstace.Location.Point
				existZ = existedP.Z
				newlocation  = XYZ(newX,newY,existZ)
				newinstace.Location.Point = newlocation
			#if forceworkplane == True and newlyplaced and initial == "Last":
			#	newinstace.IsWorkPlaneFlipped = True
			if newlyplaced and initial == "First" and safeheight != 0:
				invline(doc,newinstace,autoheight,safeheight)
			famtypeparams = list(symbol1.GetOrderedParameters()) + list(newinstace.GetOrderedParameters())
			allparams = list(doc.FamilyManager.GetParameters())
			for elemparm in famtypeparams:
				for famparam in allparams:
					if (elemparm.Definition.Name == "Height" and famparam.Definition.Name == "Height_Original" and initial == "First") or (elemparm.Definition.Name == famparam.Definition.Name and initial == "Second") or (elemparm.Definition.Name == famparam.Definition.Name and famparam.Definition.Name != "Height" and famparam.Definition.Name != "Height_Original" and initial == "First") or (elemparm.Definition.Name == "Height_Original" and famparam.Definition.Name == "Height" and initial == "Last") or (elemparm.Definition.Name == "Height" and famparam.Definition.Name == "Height_Scale" and initial == "Last") or (elemparm.Definition.Name == famparam.Definition.Name and elemparm.Definition.Name != "Height" and elemparm.Definition.Name != "Height_Original" and initial == "Last"):
						for p in paraminfo:
							if p[2] == famparam.Definition.Name:
								if p[3].ToString() == "Material":
									mat_fec = FilteredElementCollector(doc).OfClass(Material)
									for m in mat_fec:
										if m.Name.lower() == str(p[1]).lower():
											doc.FamilyManager.Set(famparam,m.Id)
								else:
									try:
										doc.FamilyManager.Set(famparam,p[1])
									except:
										try:
											doc.FamilyManager.SetValueString(famparam,p[1])
										except:
											pass
								try:
									if p[10]:
										doc.FamilyManager.SetFormula(famparam,p[9])
								except:
									pass
						try:
							doc.FamilyManager.AssociateElementParameterToFamilyParameter(elemparm,famparam)
						except:
							pass
			trans1.Commit()
			famdoc.Close(False)
			if save_path != None:
				System.IO.File.Delete(save_path)
			return "Loaded"
		else:
			return "ERROR"
	except:
		try:
			trans1.Commit()
		except:
			pass
		TransactionManager.Instance.ForceCloseTransaction()
		try:famdoc.Close(False)
		except:pass
		if save_path != None:
			System.IO.File.Delete(save_path)
		return "ERROR"


# Detect Bottom Mid Point
def midbottompoint(elem):
	bigbound = elem.get_BoundingBox(None)
	minp = bigbound.Min.ToPoint()
	maxp = bigbound.Max.ToPoint()
	maxpX = maxp.X
	maxpY = maxp.Y
	fixedmaxp = dg.Point.ByCoordinates(maxpX,maxpY,minp.Z)
	midP = dg.Curve.PointAtParameter(dg.Line.ByStartPointEndPoint(minp,fixedmaxp),0.5)
	return midP.ToXyz()

# Detect Bottom Mid Point Reversed
def midbottompointreversed(elem):
	bigbound = elem.get_BoundingBox(None)
	minp = bigbound.Min.ToPoint()
	maxp = bigbound.Max.ToPoint()
	maxpX = maxp.X
	maxpY = maxp.Y
	fixedmaxp = dg.Point.ByCoordinates(maxpX,maxpY,minp.Z)
	midP = dg.Curve.PointAtParameter(dg.Line.ByStartPointEndPoint(minp,fixedmaxp),0.5)
	newmidP = dg.Point.ByCoordinates(-midP.X,-midP.Y,minp.Z)
	return newmidP.ToXyz()

def initialfamily(fam_path,doc,famname,famcategory,isShared,isWorkplane,isVertical):
	save_path = '%s%s.rfa' % (temp_path, re.sub(r'[\\/*?:"<>|]',"",famname))
	famdoc = doc.Application.NewFamilyDocument(fam_path)
	try:
		TransactionManager.Instance.ForceCloseTransaction()
		trans1 = Transaction(famdoc, 'New ' + famname + ' Family')
		trans1.Start()
		transferunit(doc,famdoc)
		fam_cat = famdoc.Settings.Categories.get_Item(famcategory)
		famdoc.OwnerFamily.FamilyCategory = fam_cat
		try:
			famtype = famdoc.FamilyManager.NewType(famname)
			famdoc.FamilyManager.CurrentType = famtype
		except:
			pass
		if isShared == True:
			try:famdoc.OwnerFamily.get_Parameter(BuiltInParameter.FAMILY_SHARED).Set(1)
			except:pass
		else:
			try:famdoc.OwnerFamily.get_Parameter(BuiltInParameter.FAMILY_SHARED).Set(0)
			except:pass
		if isWorkplane == True:
			try:famdoc.OwnerFamily.get_Parameter(BuiltInParameter.FAMILY_WORK_PLANE_BASED).Set(1)
			except:pass
		else:
			try:famdoc.OwnerFamily.get_Parameter(BuiltInParameter.FAMILY_WORK_PLANE_BASED).Set(0)
			except:pass
		if isVertical == True:
			try:famdoc.OwnerFamily.get_Parameter(BuiltInParameter.FAMILY_ALWAYS_VERTICAL).Set(1)
			except:pass
		else:
			try:famdoc.OwnerFamily.get_Parameter(BuiltInParameter.FAMILY_ALWAYS_VERTICAL).Set(0)
			except:pass
		trans1.Commit()
		famdoc.SaveAs(save_path, SaveAsOpt)
	except:
		TransactionManager.Instance.ForceCloseTransaction()
		try:famdoc.Close(False)
		except:pass
		try:System.IO.File.Delete(save_path)
		except:pass
		famdoc = None
	return famdoc,save_path

def adaptjob(adaptfamdoc):
	famtype = [x for x in FilteredElementCollector(adaptfamdoc).OfClass(FamilySymbol).ToElements() if "k-rigged" in x.FamilyName.lower()][0]
	TransactionManager.Instance.ForceCloseTransaction()
	trans1 = Transaction(adaptfamdoc, 'Working in Adaptive Family')
	trans1.Start()
	if not famtype.IsActive: famtype.Activate()
	pt = adaptfamdoc.FamilyCreate.NewReferencePoint(XYZ.Zero)
	par = pt.LookupParameter("Point").Set(1)
	plane = pt.GetCoordinatePlaneReferenceYZ()
	newinstance = adaptfamdoc.FamilyCreate.NewFamilyInstance(plane,XYZ(0,0,0),XYZ(0,0,1),famtype)
	trans1.Commit()
	return newinstance

# Get Batch Family Parameters Information Function
def famparaminfo_2(famparam,famdoc,famtype = None):
	if famtype == None:
		famtype = famdoc.FamilyManager.CurrentType
	ParamName = famparam.Definition.Name
	is_shared = famparam.IsShared
	ParamValueString = bestparamvalue(famdoc,famtype,famparam)
	if ParamValueString == None:
		try:
			ParamValueString = famtype.AsString(famparam)
		except:
			pass
	ParamType = famparam.Definition.ParameterType
	BuiltinParam = famparam.Definition.BuiltInParameter
	BuiltinGroup = famparam.Definition.ParameterGroup
	is_instance = famparam.IsInstance
	if is_shared:
		guid = famparam.GUID
	else:
		guid = None
	formula = famparam.Formula
	if formula == None:
		is_formuladefined = False
	else:
		is_formuladefined = True
	if len(list(famparam.AssociatedParameters)):
		is_associated = True
	else:
		is_associated = False
	return famparam,ParamValueString,ParamName,ParamType,BuiltinParam,BuiltinGroup,is_instance,is_shared,guid,formula,is_formuladefined,is_associated

# Get Batch Family Parameter Information
def getparaminfo_2(famdoc,famtype = None):
	if famtype == None:
		famtype = famdoc.FamilyManager.CurrentType
	allparams = list(famdoc.FamilyManager.GetParameters())
	info= []
	for famparam in allparams:
		batchinfo = famparaminfo_2(famparam,famdoc,famtype)
		if str(batchinfo[3]) != "LoadClassification":
			info.append(batchinfo)
	tochecklater = []
	for i in info:
		if i[9] != None:
			splitted = i[9].Split(" ")
			tochecklater.append(splitted)
	tochecklater = flatten(tochecklater)
	important = []
	for i in info:
		name = i[2]
		if name in tochecklater or i[7] == True or i[3].ToString() == "Material":
			important.append(True)
		else:
			important.append(False)
	newinfo = []
	count = 0
	for im in important:
		currentinfo = info[count]
		count += 1
		tmp = []
		if im:
			if currentinfo[9] == None:
				#status = "Normal Importance"
				status = True
			else:
				#status = "Delayed Importance"
				status = True
			for i in currentinfo:
				tmp.append(i)
			tmp.append(status)
		else:
			for i in currentinfo:
				tmp.append(i)
			tmp.append(False)
		newinfo.append(tmp)
	return newinfo

# Create New Family
def creatparameters(famdoc,uiapp,paraminfos,famtypenames,famcategory,name):
	try:
		TransactionManager.Instance.ForceCloseTransaction()
		trans1 = Transaction(famdoc, 'Auto Create Types & Parameters')
		trans1.Start()
		try:
			fam_cat = famdoc.Settings.Categories.get_Item(famcategory)
			famdoc.OwnerFamily.FamilyCategory = fam_cat
		except:
			fam_cat = famdoc.Settings.Categories.get_Item("Generic Models")
			famdoc.OwnerFamily.FamilyCategory = fam_cat
		bigcount = 0
		for famtypename in famtypenames:
			paraminfo = paraminfos[bigcount]
			bigcount += 1
			try:
				if name == None:
					famtype = famdoc.FamilyManager.NewType("Adaptive" + separator + famtypename)
				else:
					famtype = famdoc.FamilyManager.NewType(name)
				famdoc.FamilyManager.CurrentType = famtype
			except:
				pass
			for p in paraminfo:
				try:
					instatus = p[6]
					if p[7] == True:
						externaldefOP = exdef(p[2],p[8],p[3],uiapp)
						externaldef = externaldefOP[0]
						try:
							freshparam = famdoc.FamilyManager.AddParameter(externaldef,p[5],instatus)
						except:
							pass
						uiapp.Application.SharedParametersFilename = externaldefOP[1]
						os.remove(externaldefOP[2])
					else:
						freshparam = famdoc.FamilyManager.AddParameter(p[2],p[5],p[3],instatus)
				except:
					pass
		trans1.Commit()
		loaded = famdoc
	except:
		try:trans1.Commit()
		except:pass
		TransactionManager.Instance.ForceCloseTransaction()
		try:famdoc.Close(False)
		except:pass
		loaded = None
	return loaded

# Load Family
def associateOP(famdoc,doc,famtypenames,paraminfos,newinstace):
	try:
		if famdoc != None and doc != None:
			bigcount = 0
			symbols = newinstace.Symbol.Family.GetFamilySymbolIds().GetEnumerator()
			symbol1s = []
			for s in symbols:
				symbol1s.append(doc.GetElement(s))
			TransactionManager.Instance.ForceCloseTransaction()
			trans1 = Transaction(doc, 'Auto Associate Parameters')
			trans1.Start()
			for symbol1 in symbol1s:
				famtypename = famtypenames[bigcount]
				paraminfo = paraminfos[bigcount]
				bigcount += 1
				if not symbol1.IsActive: symbol1.Activate()
				current_type = getfamtype(doc,famtypename)
				famtypeparams = list(symbol1.GetOrderedParameters()) + list(newinstace.GetOrderedParameters())
				allparams = list(doc.FamilyManager.GetParameters())
				for elemparm in famtypeparams:
					for famparam in allparams:
						if (elemparm.Definition.Name == famparam.Definition.Name):
							for p in paraminfo:
								if p[2] == famparam.Definition.Name:
									if p[3].ToString() == "Material":
										mat_fec = FilteredElementCollector(doc).OfClass(Material)
										for m in mat_fec:
											if m.Name.lower() == str(p[1]).lower():
												doc.FamilyManager.Set(famparam,m.Id)
									else:
										try:
											doc.FamilyManager.Set(famparam,p[1])
										except:
											try:
												doc.FamilyManager.SetValueString(famparam,p[1])
											except:
												pass
									try:
										if p[10]:
											doc.FamilyManager.SetFormula(famparam,p[9])
									except:
										pass
							try:
								doc.FamilyManager.AssociateElementParameterToFamilyParameter(elemparm,famparam)
							except:
								pass
			trans1.Commit()
			famdoc.Close(False)
			return "SUCCESS"
		else:
			return "ERROR"
	except:
		try:trans1.Commit()
		except:pass
		TransactionManager.Instance.ForceCloseTransaction()
		try:famdoc.Close(False)
		except:pass
		return "ERROR"

# Get Family Instance Information
def getinstanceinfo_2(doc,sourceinstance):
	family = sourceinstance.Symbol.Family
	familyname = family.Name
	typesids = family.GetFamilySymbolIds()
	famtypes = []
	famtypenames = []
	for id in typesids:
		ftype = doc.GetElement(id)
		famtypes.append(ftype)
		famtypenames.append(ftype.GetParameters("Type Name")[0].AsString())
	return family,familyname,famtypes,famtypenames

# Initial Family Instance Information
def initialop_2(projectdoc,sourceinstance):
	initialinfo = getinstanceinfo_2(projectdoc,sourceinstance)
	family = initialinfo[0]
	familyname = initialinfo[1]
	projectfamtypes = initialinfo[2]
	famtypenames = initialinfo[3]
	instanceparameters = sourceinstance.GetOrderedParameters()
	TransactionManager.Instance.ForceCloseTransaction()
	famdoc = projectdoc.EditFamily(family)
	trans1 = Transaction(famdoc, 'Initial Operation')
	trans1.Start()
	warnhandle = WarnSwallowSimple()
	foptions = trans1.GetFailureHandlingOptions()
	foptions.SetFailuresPreprocessor(warnhandle)
	trans1.SetFailureHandlingOptions(foptions)
	originalcat = famdoc.OwnerFamily.FamilyCategory.Name
	allinfos = []
	paraminfos = []
	for famtypename in famtypenames:
		famtype = getfamtype(famdoc,famtypename)
		allinfo = getparaminfo_2(famdoc,famtype)
		paraminfos.append(allinfo)
	trans1.Commit()
	tmpfamtypenames = []
	for f in famtypenames:
		tmpfamtypenames.append(f)
	famtypenames = tmpfamtypenames
	return famdoc,paraminfos,originalcat,famtypenames

def ref_pt(l1, par1, doc, pmt = PointOnCurveMeasurementType.NormalizedCurveParameter, pmf = PointOnCurveMeasureFrom.Beginning):
	factory = doc.FamilyCreate
	loc1 = PointLocationOnCurve(pmt, par1, pmf)
	ref1 = l1.GeometryCurve.Reference
	uiapp = DocumentManager.Instance.CurrentUIApplication
	app = uiapp.Application.Create
	pt_ref = app.NewPointOnEdge(ref1, loc1)
	return factory.NewReferencePoint(pt_ref)

def ref_line(pts, doc):
	factory = doc.FamilyCreate
	pt_arr = ReferencePointArray()
	pt_arr.Append(pts[0])
	pt_arr.Append(pts[1])
	l1 = factory.NewCurveByPoints(pt_arr)
	l1.IsReferenceLine = True
	l1.ReferenceType = ReferenceType.None
	return l1

def getorsetfamparam(paramname,paramgroup,paramtype,isinstance,doc):
	try:
		param = doc.FamilyManager.AddParameter(paramname,paramgroup,paramtype,isinstance)
	except:
		allparams = doc.FamilyManager.GetParameters()
		for param in allparams:
			if param.Definition.Name == paramname:
				break
	return param

def genstuff(doc,heightparam,extralength,extradepth):
	extralength = extralength * 2
	extradepth = extradepth * 2
	result = []
	adaptfamtype = [x for x in FilteredElementCollector(doc).OfClass(FamilySymbol).ToElements() if "k-rigged" in x.FamilyName.lower()][0]
	TransactionManager.Instance.ForceCloseTransaction()
	trans1 = Transaction(doc, 'Working In Pattern Family')
	trans1.Start()
	warnhandle = WarnSwallowSimple()
	foptions = trans1.GetFailureHandlingOptions()
	foptions.SetFailuresPreprocessor(warnhandle)
	trans1.SetFailureHandlingOptions(foptions)
	if not adaptfamtype.IsActive: adaptfamtype.Activate()
	allcurves = list(FilteredElementCollector(doc).OfClass(CurveElement).WhereElementIsNotElementType())
	result.append(ref_pt(allcurves[0],0.5,doc))
	result.append(ref_pt(allcurves[2],0.5,doc))
	doc.Regenerate()
	refline = ref_line(result,doc)
	midpt = ref_pt(refline,0.5,doc)
	dimrefs = ReferenceArray()
	dimrefs.Append(Reference(allcurves[0]))
	dimrefs.Append(Reference(allcurves[2]))
	all_views = FilteredElementCollector(doc).OfClass(View)
	active_view = None
	for view in all_views:
		if str(view.ViewType) == 'ThreeD' and not view.IsTemplate:
			break
	dim = doc.FamilyCreate.NewLinearDimension(view,refline.GeometryCurve,dimrefs)
	report_param = getorsetfamparam("Report_Width",BuiltInParameterGroup.INVALID,ParameterType.Length,True,doc)
	size_param = getorsetfamparam("K-Pattern Size",BuiltInParameterGroup.INVALID,ParameterType.Text,False,doc)
	try:
		dim.FamilyLabel = report_param
	except:
		pass
	doc.FamilyManager.MakeReporting(report_param)
	if not adaptfamtype.IsActive: adaptfamtype.Activate()
	adaptfam = AdaptiveComponentInstanceUtils.CreateAdaptiveComponentInstance(doc,adaptfamtype)
	adaptpoint = doc.GetElement(AdaptiveComponentInstanceUtils.GetInstancePointElementRefIds(adaptfam)[0])
	adaptpoint.SetPointElementReference(midpt.GetPointElementReference())
	doc.Delete(midpt.Id)
	doc.Regenerate()
	trans1.Commit()
	bbox1 = PROgetgeom(doc,adaptfam).ToCuboid()
	bbox2 = adaptfam.get_BoundingBox(None).ToProtoType().ToCuboid()
	if (bbox1.Width + bbox1.Length) < (bbox2.Width + bbox2.Length):
		bbox = bbox1
	else:
		bbox = bbox2
	TransactionManager.Instance.ForceCloseTransaction()
	trans1 = Transaction(doc, 'Working In Pattern Family')
	trans1.Start()
	warnhandle = WarnSwallowSimple()
	foptions = trans1.GetFailureHandlingOptions()
	foptions.SetFailuresPreprocessor(warnhandle)
	trans1.SetFailureHandlingOptions(foptions)
	bboxlength = bbox.Length + extralength
	bboxwidth = bbox.Width + extradepth
	bbox.Dispose()
	if int(DocumentManager.Instance.CurrentUIApplication.Application.VersionNumber) < 2021:
		doc.OwnerFamily.CurtainPanelVerticalSpacing = UnitUtils.ConvertToInternalUnits(bboxlength,doc.GetUnits().GetFormatOptions(UnitType.UT_Length).DisplayUnits)
		doc.OwnerFamily.CurtainPanelHorizontalSpacing = UnitUtils.ConvertToInternalUnits(bboxwidth,doc.GetUnits().GetFormatOptions(UnitType.UT_Length).DisplayUnits)
	else:
		doc.OwnerFamily.CurtainPanelVerticalSpacing = UnitUtils.ConvertToInternalUnits(bboxlength,doc.GetUnits().GetFormatOptions(SpecTypeId.Length).GetUnitTypeId())
		doc.OwnerFamily.CurtainPanelHorizontalSpacing = UnitUtils.ConvertToInternalUnits(bboxwidth,doc.GetUnits().GetFormatOptions(SpecTypeId.Length).GetUnitTypeId())
	cur_width = bboxwidth
	cur_length = bboxlength
	num1 = round(cur_length,6)
	num2 = round(cur_width,6)
	sizename = str(num1) + " x " + str(num2)
	name = "Size " + sizename
	curfamtype = getfamtype(doc,name)
	doc.FamilyManager.RenameCurrentType(name)
	height_param = getorsetfamparam(heightparam,BuiltInParameterGroup.PG_GEOMETRY,ParameterType.Length,True,doc)
	lookedup = adaptfam.LookupParameter(heightparam)
	defaultheight = lookedup.AsDouble()
	doc.FamilyManager.Set(height_param,defaultheight)
	if int(DocumentManager.Instance.CurrentUIApplication.Application.VersionNumber) < 2021:
		formula = "(" + str(UnitUtils.ConvertFromInternalUnits(defaultheight,doc.GetUnits().GetFormatOptions(UnitType.UT_Length).DisplayUnits)) + "*" + report_param.Definition.Name + ")" + "/" + str(cur_length)
	else:
		formula = "(" + str(UnitUtils.ConvertFromInternalUnits(defaultheight,doc.GetUnits().GetFormatOptions(SpecTypeId.Length).GetUnitTypeId())) + "*" + report_param.Definition.Name + ")" + "/" + str(cur_length)
	doc.FamilyManager.SetFormula(height_param,formula)
	doc.FamilyManager.AssociateElementParameterToFamilyParameter(lookedup,height_param)
	doc.FamilyManager.Set(size_param,sizename)
	trans1.Commit()
	return adaptfam,name,sizename

def PROgetgeom(doc,geom,originalnotjoinedgeom = False,includehiddengeom = False):
	def on_dialog_open(sender, event):
	    try:
	        if event.DialogId == 'TaskDialog_Really_Print_Or_Export_Temp_View_Modes':
	            event.OverrideResult(1002) 
	    except Exception as e:
	        pass

	def cleangeomlist(geoms):
		filteredgeoms = []
		for e in geoms:
			if isinstance(e,str) or isinstance(e,dg.Solid) or isinstance(e,dg.Surface) or isinstance(e,dg.PolySurface) or isinstance(e,dg.Cuboid):
				filteredgeoms.append(e)
		return filteredgeoms
	
	# Better SAT Import Function
	def betteimport(doc,sat,temp_path):
		geoms = dg.Geometry.ImportFromSAT(sat)
		sat_path = None
		try:
			if int(DocumentManager.Instance.CurrentUIApplication.Application.VersionNumber) < 2021:
				factor = round(UnitUtils.ConvertFromInternalUnits(3.280839895,doc.GetUnits().GetFormatOptions(UnitType.UT_Length).DisplayUnits),8) * 1000
			else:
				factor = round(UnitUtils.ConvertFromInternalUnits(3.280839895,doc.GetUnits().GetFormatOptions(SpecTypeId.Length).GetUnitTypeId()),8) * 1000
			randomname = ''.join([random.choice(string.ascii_letters + string.digits) for n in xrange(5)])
			sat_path = '%s%s.sat' % (temp_path, randomname)
			dg.Geometry.ExportToSAT(geoms,sat_path,factor)
			for g in geoms:
				g.Dispose()
			scaledgeoms = dg.Geometry.ImportFromSAT(sat_path)
		except:
			scaledgeoms = geoms
		if sat_path != None:
			System.IO.File.Delete(sat_path)
		return scaledgeoms
	
	def tolist(obj1):
		if hasattr(obj1,'__iter__'): return obj1
		else: return [obj1]
	
	def flatten(x):
	    result = []
	    try:
	    	for el in x:
	        	if hasattr(el, "__iter__") and not isinstance(el, basestring):
	        	    result.extend(flatten(el))
	        	else:
	        	    result.append(el)
	    except:
	    	result = x
	    return result
	    
	def analgeom(elem):
		result = []
		try:
			breakstatus = False
			geoms = elem.get_Geometry(opt1)
			extracted = []
			for e in geoms:
				if e.ToString() == "Autodesk.Revit.DB.GeometryInstance":
					try:
						extracted.append(e.GetInstanceGeometry())
					except:
						pass
				elif e.ToString() == "Autodesk.Revit.DB.Solid":
					extracted.append(e)
			if len(extracted) == 0:
				breakstatus = True
			else:
				extracted = flatten(extracted)
				geoms = extracted
			if breakstatus == False:
				for e in geoms:
					try:
						if e.ToString() == "Autodesk.Revit.DB.Solid":
							attempt = e.ToProtoType()
							if attempt == None:
								if len(result) != 0:
									for r in result:
										try: r.Dispose()
										except: pass
								return False
							else:
								result.append(attempt)	
					except:
						if len(result) != 0:
							for r in result:
								try: r.Dispose()
								except: pass
							result = []
							break
			if len(result) == 0:
				return False
			else:
				newresult = []
				for e in result:
					if e != None:
						newresult.append(e)
				if len(newresult) == 0:
					return False
				else:
					return newresult
		except:
			return "Fail"
	
	if geom != None:
		geom = tolist(geom)
	else:
		pass
	
	class WarnSwallow(IFailuresPreprocessor):
		def PreprocessFailures(self, failuresAccessor):
			failuresAccessor.DeleteAllWarnings()
			return FailureProcessingResult.Continue
	
	
	if originalnotjoinedgeom == True:
		from itertools import compress
		from itertools import combinations
		
		elements = flatten(geom)
		allwalls = True
		
		bboxes = []
		accept = []
		for e in elements:
			try:
				bb = e.get_BoundingBox(None)
				bboxes.append(bb.ToProtoType())
				accept.append(True)
			except:
				accept.append(False)
				
		acceptedelements = list(compress(elements, accept))
		
		tocombineraw = combinations(acceptedelements,2)
		tocombinebboxraw = combinations(bboxes,2)
		
		comb = []
		for i in list(tocombineraw): 
		    comb.append(i)
		
		tocombine = comb
		
		comb2 = []
		for i in list(tocombinebboxraw): 
		    comb2.append(i)
		
		tocombinebbox = comb2
		
		if allwalls == False:
			result = []
			allresult = []
			for eachlist in tocombine:
				tmplist = []
				for each in eachlist:
					if str(each.ToString()) == "Autodesk.Revit.DB.Wall":
						tmplist.append(True)
					else:
						tmplist.append(False)
				result.append(tmplist)
		
			for each in result:
				if all(each) == True:
					allresult.append(False)
				else:
					allresult.append(True)
			filtered = list(compress(tocombine, allresult))
			filteredbbox = list(compress(tocombinebbox, allresult))
		else:
			filtered = tocombine
			filteredbbox = tocombinebbox
		
		BBOX1 = [item[0] for item in filteredbbox]
		BBOX2 = [item[1] for item in filteredbbox]
		
		intersects = []
		
		count = 0
		for each in BBOX1:
			intersects.append(dg.BoundingBox.Intersects(each,BBOX2[count]))
			count = count + 1
		
		count = 0
		for each in BBOX1:
			each.Dispose()
			BBOX2[count].Dispose()
			count = count + 1
		
		intersectingelements = list(compress(filtered, intersects))
		
		listj = len(intersectingelements)
		count = 0
		arejoined = []
		while (count < listj):
				result = JoinGeometryUtils.AreElementsJoined(doc, intersectingelements[count][0], intersectingelements[count][1])
				count = count + 1
				arejoined.append(result)
		
		joined = list(compress(intersectingelements, arejoined))
	
	temp_path = System.IO.Path.GetTempPath()
	satOpt = SATExportOptions()
	opt1 = Options()
	
	if includehiddengeom == True:
		opt1.IncludeNonVisibleObjects = True
	
	#Find a 3D view type
	collector1 = FilteredElementCollector(doc)
	viewFamilyTypes = collector1.OfClass((ViewFamilyType))
	for e in viewFamilyTypes:
		if str(e.ViewFamily) == "ThreeDimensional":
			viewType = e.Id
			break
	
	def NewForm_background(s1):
		DocumentManager.Instance.CurrentUIApplication.DialogBoxShowing += on_dialog_open
		TransactionManager.Instance.ForceCloseTransaction()
		try:
			randomname = ''.join([random.choice(string.ascii_letters + string.digits) for n in xrange(5)])
			trans1 = Transaction(doc, 'Fetching Geometry')
			foptions = trans1.GetFailureHandlingOptions()
			foptions.SetFailuresPreprocessor(WarnSwallow())
			trans1.SetFailureHandlingOptions(foptions)
			trans1.Start()
			if originalnotjoinedgeom == True:
				jointcount = 0
				while (jointcount < len(joined)):
					try:
						JoinGeometryUtils.UnjoinGeometry(doc, joined[jointcount][0], joined[jointcount][1])
						jointcount = jointcount + 1
					except:
						jointcount = jointcount +1
				doc.Regenerate()
			sat_path = '%s%s.sat' % (temp_path, randomname)
			status = True
			finalres = []
			for each in s1:
				try:
					oldvalue = 1
					eparm = each.LookupParameter("Visible")
					if eparm != None:
						if doc.FamilyManager.GetAssociatedFamilyParameter(eparm) != None:
							doc.FamilyManager.AssociateElementParameterToFamilyParameter(eparm, None)
						pname = eparm.Definition.Name
						oldvalue = eparm.AsInteger()
						if oldvalue == 0:
							eparm.Set(1)
				except:
					continue
				resultgeom = analgeom(each)
				if resultgeom == "Fail":
					finalres.append([None])
					continue
				elif resultgeom == False:
					resultgeom = []
					threedeeview = View3D.CreateIsometric(doc, viewType)
					threedeeviewid = threedeeview.Id
					try:
						wantedsub = doc.Settings.Categories.get_Item(BuiltInCategory.OST_Mass)
						threedeeview.SetCategoryHidden(wantedsub.Id,False)
					except:
						pass
					kilist = List[ElementId]([threedeeviewid])
					tid = []
					tid = [each.Id]
					ielements = List[ElementId](tid)
					threedeeview.IsolateElementsTemporary(ielements)
					collectorinside = FilteredElementCollector(doc,threedeeviewid).ToElements()
					elemento = []
					for k in collectorinside:
						elemento.append(int(str(k.Id)))
					if int(str(each.Id)) in elemento:
						doc.Export(temp_path, randomname, kilist, satOpt)
						eachlist = betteimport(doc,sat_path,temp_path)
						tmplist = []
						for e in eachlist:
							tmplist.append(e)
						resultgeom.append(tmplist)
						System.IO.File.Delete(sat_path)
					else:
						resultgeom = [None]
					doc.Delete(threedeeview.Id)
				finalres.append(flatten(resultgeom))
				if oldvalue == 0:
					eparm.Set(0)
			trans1.RollBack()
			return finalres
		except:
			trans1.RollBack()
			TransactionManager.Instance.ForceCloseTransaction()
			return traceback.format_exc(),''
	try:
		result = NewForm_background(geom)
		result = flatten(result)
		bbox = dg.BoundingBox.ByGeometry(result)
		for rs in result:
			rs.Dispose()
	except:
		bbox = None
	satOpt.Dispose()
	opt1.Dispose()
	return bbox

# Family Saving Options
SaveAsOpt = SaveAsOptions()
SaveAsOpt.OverwriteExistingFile = True
temp_path = System.IO.Path.GetTempPath()

# Initial Family Instance Info
sourceinstance = UnwrapElement(IN[0])
hostwidth = IN[1]
fam_path = IN[2]
adapt_fam_path = IN[3]
pat_fam_path = IN[4]
overwriteparameters = True
extralength = IN[5]
extradepth = IN[6]
safeheight = IN[7]
autoheight = False

instance = True
separator = "_"
forceworkplane = True


# Project Document and UI
projectdoc = DocumentManager.Instance.CurrentDBDocument
uiapp = DocumentManager.Instance.CurrentUIApplication

# Convert Host Width to Internal Units
if int(DocumentManager.Instance.CurrentUIApplication.Application.VersionNumber) < 2021:
	hostwidth = UnitUtils.ConvertToInternalUnits(hostwidth,projectdoc.GetUnits().GetFormatOptions(UnitType.UT_Length).DisplayUnits)
else:
	hostwidth = UnitUtils.ConvertToInternalUnits(hostwidth,projectdoc.GetUnits().GetFormatOptions(SpecTypeId.Length).GetUnitTypeId())

try:
	# Getting Info From Initial Family
	initialOP = initialop(projectdoc,sourceinstance,hostwidth,autoheight,safeheight)
	
	# Familiy is Writable
	familywritable = True
except:
	# Familiy is Not Writable
	familywritable = False
	
	# Show Message
	OUT = TaskDialog.Show("AECedx - Karam", "Please Close The Opened Family")

# Check if Family is Writable
if familywritable:

	# Variables
	resultname = initialOP[0]
	initialfamdoc = initialOP[1]
	paraminfo = initialOP[2]
	isfam_shared = initialOP[3]
	isfam_workplane = initialOP[4]
	isfam_vertical = initialOP[5]
	isfam_cuts = initialOP[6]
	maxheight = initialOP[7]
	originalcat = initialOP[8]
	famtypename = initialOP[9]
	typemark = initialOP[10]
	isceiling = initialOP[11]
	
	# Check If Forced  Workplane
	if forceworkplane:
		isfam_workplane = True

	TransactionManager.Instance.ForceCloseTransaction()
	tGroup = TransactionGroup(projectdoc, 'Load K-Pattern Magic')
	tGroup.Start()

	# Creating First Planting Family
	firstplantOP = createfamily(fam_path,initialfamdoc,uiapp,"First " + resultname,"Planting",False,False,False,False,maxheight,paraminfo,instance,"First")
	firstplantdoc = firstplantOP[0]
	firstplantsavepath = firstplantOP[1]
	
	# Load Initial to First Planting
	loadOP(initialfamdoc,firstplantdoc,None,famtypename,paraminfo,"First",forceworkplane,isceiling,autoheight,safeheight)
	
	# Creating Second Planting Family
	secondplantOP = createfamily(fam_path,initialfamdoc,uiapp,"Second " + resultname,"Planting",False,False,False,False,maxheight,paraminfo,instance,"Second")
	secondplantdoc = secondplantOP[0]
	secondplantsavepath = secondplantOP[1]
	
	# Load First to Second Planting
	loadOP(firstplantdoc,secondplantdoc,firstplantsavepath,None,paraminfo,"Second",forceworkplane,isceiling,autoheight,safeheight)
	
	# Creating Final Family
	finalfamilyOP = createfamily(fam_path,initialfamdoc,uiapp,resultname,originalcat,False,isfam_workplane,False,isfam_cuts,maxheight,paraminfo,instance,"Last")
	finalfamilydoc = finalfamilyOP[0]
	finalfamilysavepath = finalfamilyOP[1]
	
	# Load Second to Final Family
	loadOP(secondplantdoc,finalfamilydoc,secondplantsavepath,None,paraminfo,"Last",forceworkplane,isceiling,autoheight,safeheight)
	
	adaptfam = initialfamily(adapt_fam_path,projectdoc,"Adaptive" + separator + resultname,"Generic Models",False,False,False)
	adaptfamdoc = adaptfam[0]
	adaptfamsavepath = adaptfam[1]
	if overwriteparameters:
		finalfamilydoc.LoadFamily(adaptfamdoc,FamOpt1())
	else:
		finalfamilydoc.LoadFamily(adaptfamdoc,FamOptWithout())
	finalfamilydoc.Close(False)
	System.IO.File.Delete(finalfamilysavepath)
	sourceinstance = adaptjob(adaptfamdoc)

	initialOP = initialop_2(adaptfamdoc,sourceinstance)
	initialfamdoc = initialOP[0]
	paraminfos = initialOP[1]
	originalcat = initialOP[2]
	famtypenames = initialOP[3]
	creatparameters(adaptfamdoc,uiapp,paraminfos,famtypenames,originalcat,None)
	associateOP(initialfamdoc,adaptfamdoc,famtypenames,paraminfos,sourceinstance)
	
	fixedpatname = "K-Pattern" + resultname.replace("K-Rigged", "")
	patfam = initialfamily(pat_fam_path,projectdoc,fixedpatname,"Generic Models",True,False,False)
	patfamdoc = patfam[0]
	patfamsavepath = patfam[1]
	
	if overwriteparameters:
		adaptfamdoc.LoadFamily(patfamdoc,FamOpt1())
	else:
		adaptfamdoc.LoadFamily(patfamdoc,FamOptWithout())
	adaptfamdoc.Close(False)
	System.IO.File.Delete(adaptfamsavepath)
	
	genOP = genstuff(patfamdoc,"Height_Scale",extralength,extradepth)
	sourceinstance = genOP[0]
	name = genOP[1]
	sizename = genOP[2]
	
	initialOP = initialop_2(patfamdoc,sourceinstance)
	initialfamdoc = initialOP[0]
	paraminfos = initialOP[1]
	originalcat = initialOP[2]
	famtypenames = initialOP[3]
	creatparameters(patfamdoc,uiapp,paraminfos,famtypenames,originalcat,name)
	associateOP(initialfamdoc,patfamdoc,famtypenames,paraminfos,sourceinstance)
	
	existedpat = [x for x in FilteredElementCollector(projectdoc).OfClass(Family).ToElements() if fixedpatname.ToLower() == x.Name.lower()]
	safesymbols = []
	if len(existedpat) > 0:
		safesymbols = list(existedpat[0].GetFamilySymbolIds())
		
	if overwriteparameters:
		loadedpat = patfamdoc.LoadFamily(projectdoc,FamOpt1())
	else:
		loadedpat = patfamdoc.LoadFamily(projectdoc,FamOptWithout())
	patfamdoc.Close(False)
	System.IO.File.Delete(patfamsavepath)
	
	TransactionManager.Instance.ForceCloseTransaction()
	trans1 = Transaction(projectdoc, 'Fix Size Name')
	trans1.Start()
	warnhandle = WarnSwallowSimple()
	foptions = trans1.GetFailureHandlingOptions()
	foptions.SetFailuresPreprocessor(warnhandle)
	trans1.SetFailureHandlingOptions(foptions)
	symbolids = list(loadedpat.GetFamilySymbolIds())
	bestsymbol = False
	for sym in symbolids:
		if len(safesymbols) > 0 and sym not in safesymbols:
			bestsymbol = sym
			continue
		symelem = projectdoc.GetElement(sym)
		if not symelem.IsActive: symelem.Activate()
		symname = symelem.GetParameters("Type Name")[0].AsString()
		origname = symelem.LookupParameter("K-Pattern Size").AsString()
		if origname != None:
			newsymname = symname.replace(origname,sizename)
			symelem.LookupParameter("K-Pattern Size").Set(sizename)
			if symname != newsymname:
				symelem.Name = newsymname
	if bestsymbol != False:
		goodparams = []
		bestparams = projectdoc.GetElement(bestsymbol).GetOrderedParameters()
		for bparam in bestparams:
			if bparam.StorageType.ToString() != "ElementId":
				goodparams.append([bparam.Definition.Name,bestparamvalue(None,None,bparam)])
		for badsym in symbolids:
			if badsym != bestsymbol:
				badparams = projectdoc.GetElement(badsym).GetOrderedParameters()
				for badparam in badparams:
					for goodparam in goodparams:
						if badparam.Definition.Name == goodparam[0]:
							try:
								badparam.Set(goodparam[1])
							except:
								pass
		projectdoc.Delete(bestsymbol)
	trans1.Commit()
	tGroup.Assimilate()
	OUT = loadedpat
# ----------------------------------------
VAROutput = Output(python_script)
