# Dynamo custom node K-Plan.dyf (Dynamo 2.13.1.3887)
# category: Synthesize.Automate.Views
# K-Plan
# packages: Synthesize toolkit 12.6.3

VARRotationDegree = Input(VARRotationDegree: var[]..[])
VARAxisModelLine = Input(VARAxisModelLine: var[]..[])
current = Document.Current()
activeView = Document.ActiveView(document=current)
code_block = CodeBlock { "View Name"; " "; }
getParameterValueByName = Element.GetParameterValueByName(element=activeView, parameterName=code_block.out0)
VARSuffix = Input(VARSuffix: var[]..[])
code_block_2 = CodeBlock(a=getParameterValueByName, b=code_block.out1, c=VARSuffix) { a+b+c; }
VARDetailing = Input(VARDetailing: var[]..[])
viewDuplicate = Custom[QU.ViewDuplicate](VARViews=activeView, VARNames=code_block_2, VARDetailing=VARDetailing)  # package Synthesize toolkit; Duplicate views with given names.
list_firstitem_fixer = Custom[List.FirstItem Fixer](VARlist=viewDuplicate)  # package Synthesize toolkit; List.FirstItem Fixer
end = Revit.Transaction.Transaction.End(input=list_firstitem_fixer)
k_plan_function = Custom[K-Plan Function](VARRotationDegree=VARRotationDegree, VARAxisLine=VARAxisModelLine, VARView=end)  # package Synthesize toolkit; K-Plan
VARView = Output(k_plan_function)
