# Dynamo custom node K-Rig Profile.dyf (Dynamo 2.1.0.7500)
# category: Synthesize.Automate.Family
# K-Rig Profile

VARProfile = Input(VARProfile: var[]..[])
VARGenricModelTemplatePath = Input(VARGenricModelTemplatePath: var[]..[])
VARGenricModelAdaptiveTemplatePath = Input(VARGenricModelAdaptiveTemplatePath: var[]..[])
VARIsInstance = Input(VARIsInstance: var[]..[])
VARFamilyName = Input(VARFamilyName: var[]..[])
python_script = Python(IN[0]=VARProfile, IN[1]=VARGenricModelTemplatePath, IN[2]=VARGenricModelAdaptiveTemplatePath, IN[3]=VARIsInstance, IN[4]=VARFamilyName)
# ---------- python_script.python (448 lines) ----------
# Proudly Created By Karam Baki : karam@aecedx.com
# Enable Python support and load DesignScript library
# IMPORTANT : ALL DYNAMO DESIGN SCRIPT NODES ARE AS (dg)
import clr
clr.AddReference('ProtoGeometry')
from Autodesk.DesignScript import Geometry as dg

# EXTENSION Enable ToDSType
clr.AddReference('RevitNodes')
import Revit
clr.ImportExtensions(Revit.Elements)

# Enable Revit Elements
from Revit.Elements import *

# EXTENSION Enable Geometry Conversion Methods
clr.ImportExtensions(Revit.GeometryConversion)

# Enable Revit API
clr.AddReference('RevitAPI')
from Autodesk.Revit.DB import *

# Enable DocumentManager and TransactionManager
clr.AddReference('RevitServices')
from RevitServices.Persistence import DocumentManager
from RevitServices.Transactions import TransactionManager

# Enable ICollection List Translate
clr.AddReference("System")
import System.Collections.Generic
from System.Collections.Generic import List
import System
import sys
pf_path = System.Environment.GetFolderPath(System.Environment.SpecialFolder.ProgramFilesX86)
sys.path.append('%s\IronPython 2.7\Lib' %pf_path)
import re

SaveAsOpt = SaveAsOptions()
SaveAsOpt.OverwriteExistingFile = True

# Transfer Document Units
def transferunit(doc,famdoc):
	if int(DocumentManager.Instance.CurrentUIApplication.Application.VersionNumber) < 2021:
		unit = famdoc.GetUnits()
		currectformat = doc.GetUnits().GetFormatOptions(UnitType.UT_Length)
		accuracy = currectformat.Accuracy
		unit.SetFormatOptions(UnitType.UT_Length,FormatOptions(currectformat.DisplayUnits,accuracy))
		famdoc.SetUnits(unit)
	else:
		unit = famdoc.GetUnits()
		currectformat = doc.GetUnits().GetFormatOptions(SpecTypeId.Length)
		unit.SetFormatOptions(SpecTypeId.Length,currectformat)
		famdoc.SetUnits(unit)

def tolist(obj1):
	if hasattr(obj1,'__iter__'): return obj1
	else: return [obj1]

def flatten(x):
    result = []
    for el in x:
        if hasattr(el, "__iter__") and not isinstance(el, basestring):
            result.extend(flatten(el))
        else:
            result.append(el)
    return result

class FamOpt1(IFamilyLoadOptions):
	def __init__(self):
		pass
	def OnFamilyFound(self,familyInUse, overwriteParameterValues):
		return True
	def OnSharedFamilyFound(self,familyInUse, source, overwriteParameterValues):
		return True

class WarnSwallow(IFailuresPreprocessor):
	def PreprocessFailures(self, failuresAccessor):
		failuresAccessor.DeleteAllWarnings()
		return FailureProcessingResult.Continue

temp_path = System.IO.Path.GetTempPath()

dataEnteringNode = IN
# Use UnwrapElement(IN[0]) When Translating From Dynamo to Revit
curves=UnwrapElement(flatten(tolist(IN[0])))
fam_path=UnwrapElement(IN[1])
fam_path_adaptive=UnwrapElement(IN[2])
isInstance=IN[3]
name=IN[4]

tmpscale = "tmpscale"
finalscale = "Scale"

# Choose The Current Document
doc = DocumentManager.Instance.CurrentDBDocument
uidoc = DocumentManager.Instance.CurrentUIApplication.ActiveUIDocument
uiapp = DocumentManager.Instance.CurrentUIApplication
app = uiapp.Application

if int(DocumentManager.Instance.CurrentUIApplication.Application.VersionNumber) < 2021:
	unit_type = UnitType.UT_Length
	formatoptions = doc.GetUnits().GetFormatOptions(unit_type)
	dispunits = formatoptions.DisplayUnits
	factor = UnitUtils.ConvertToInternalUnits(1,dispunits)
else:
	factor = UnitUtils.ConvertToInternalUnits(1,doc.GetUnits().GetFormatOptions(SpecTypeId.Length).GetUnitTypeId())

# Create Empty List
result = []
def sketchplane(doc):
	collector = SketchPlane.Create(doc,doc.GetElement(FilteredElementCollector(doc).OfCategory(BuiltInCategory.OST_Levels).WhereElementIsNotElementType().FirstElementId()).GetPlaneReference())
	return collector
	
def modelcurves(doc,curvelist):
	sketch = sketchplane(doc)
	curvearr = CurveArray()
	for c in curvelist:
		try:
			curvearr.Append(c.ToRevitType())
		except:
			pass
	try:
		result = doc.FamilyCreate.NewModelCurveArray(curvearr,sketch)
	except:
		result = None
	return result

def initialfamily(fam_path,doc,famname,famcategory,createcurves,curves,loadit,placeit,isShared,isWorkplane,isVertical,tmpscale):
	save_path = '%s%s.rfa' % (temp_path, re.sub(r'[\\/*?:"<>|]',"",famname))
	famdoc = doc.Application.NewFamilyDocument(fam_path)
	try:
		TransactionManager.Instance.ForceCloseTransaction()
		trans1 = Transaction(famdoc, 'New ' + famname + ' Family')
		trans1.Start()
		transferunit(doc,famdoc)
		fam_cat = famdoc.Settings.Categories.get_Item(famcategory)
		famdoc.OwnerFamily.FamilyCategory = fam_cat
		try:
			famtype = famdoc.FamilyManager.NewType(famname)
			famdoc.FamilyManager.CurrentType = famtype
		except:
			pass
		parms = famdoc.FamilyManager.GetParameters()
		createscale = True
		for epms in parms:
			pname = epms.Definition.Name
			if pname == "Height":
				famdoc.FamilyManager.Set(epms, factor)
				createscale = False
		if createcurves == True:
			modelcurves(famdoc,curves)
		if createscale == True:
			scaleparm = famdoc.FamilyManager.AddParameter(tmpscale,BuiltInParameterGroup.INVALID,ParameterType.Length,False)
			famdoc.FamilyManager.Set(scaleparm, factor)
		if isShared == True:
			try:famdoc.OwnerFamily.get_Parameter(BuiltInParameter.FAMILY_SHARED).Set(1)
			except:pass
		else:
			try:famdoc.OwnerFamily.get_Parameter(BuiltInParameter.FAMILY_SHARED).Set(0)
			except:pass
		if isWorkplane == True:
			try:famdoc.OwnerFamily.get_Parameter(BuiltInParameter.FAMILY_WORK_PLANE_BASED).Set(1)
			except:pass
		else:
			try:famdoc.OwnerFamily.get_Parameter(BuiltInParameter.FAMILY_WORK_PLANE_BASED).Set(0)
			except:pass
		if isVertical == True:
			try:famdoc.OwnerFamily.get_Parameter(BuiltInParameter.FAMILY_ALWAYS_VERTICAL).Set(1)
			except:pass
		else:
			try:famdoc.OwnerFamily.get_Parameter(BuiltInParameter.FAMILY_ALWAYS_VERTICAL).Set(0)
			except:pass
		trans1.Commit()
		famdoc.SaveAs(save_path, SaveAsOpt)
		if loadit == True:
			loaded = famdoc.LoadFamily(doc,FamOpt1())
			symbols = loaded.GetFamilySymbolIds().GetEnumerator()
			symbols.MoveNext()
			symbol1 = doc.GetElement(symbols.Current)
			TransactionManager.Instance.ForceCloseTransaction()
			trans1 = Transaction(doc, 'Placing Family')
			trans1.Start()
			if not symbol1.IsActive: symbol1.Activate()
			findplantings = doc.GetElement(FilteredElementCollector(doc).OfCategory(BuiltInCategory.OST_Planting).WhereElementIsNotElementType().FirstElementId())
			if findplantings == None and placeit == True:
				doc.FamilyCreate.NewFamilyInstance(XYZ.Zero, symbol1, Structure.StructuralType.NonStructural)
			trans1.Commit()
			famdoc.Close(False)
			System.IO.File.Delete(save_path)
		else:
			loaded = famdoc
	except:
		TransactionManager.Instance.ForceCloseTransaction()
		try:famdoc.Close(False)
		except:pass
		try:System.IO.File.Delete(save_path)
		except:pass
		loaded = None
	return loaded

def adaptiveop(doc,isInstance,tmpscale,finalscale):
	pt = doc.FamilyCreate.NewReferencePoint(XYZ.Zero)
	parms = pt.GetOrderedParameters()
	for par in parms:
		name =  par.Definition.Name
		if name == "Point":
			par.Set(1)
			break
	parms = pt.GetOrderedParameters()
	for par in parms:
		name =  par.Definition.Name
		if name == "Orients to":
			par.Set(2)
			break
	plane = pt.GetCoordinatePlaneReferenceXY()
	ptonplane = app.Create.NewPointOnPlane(plane,UV(),UV(),0)
	refpt1 = doc.FamilyCreate.NewReferencePoint(ptonplane)
	
	plane = refpt1.GetCoordinatePlaneReferenceXZ()
	ptonplane = app.Create.NewPointOnPlane(plane,UV(),UV(),0)
	refpt2 = doc.FamilyCreate.NewReferencePoint(ptonplane)
	
	plane = refpt2.GetCoordinatePlaneReferenceXZ()
	ptonplane = app.Create.NewPointOnPlane(plane,UV(),UV(),0)
	refpt3 = doc.FamilyCreate.NewReferencePoint(ptonplane)
	
	getscale = False
	getscalenum = False
	getself = False
	getX = False
	getY = False
	getXoffset = False
	getYoffset = False
	getZoffset = False
	try:P_Scale = doc.FamilyManager.AddParameter(tmpscale,BuiltInParameterGroup.PG_GEOMETRY,ParameterType.Length,isInstance)
	except:getscale = True
	try:P_ScaleNum = doc.FamilyManager.AddParameter(finalscale,BuiltInParameterGroup.PG_GEOMETRY,ParameterType.Number,isInstance)
	except:getscalenum = True
	try:P_rotself = doc.FamilyManager.AddParameter("Rotate Self",BuiltInParameterGroup.PG_GEOMETRY,ParameterType.Angle,isInstance)
	except:getself = True
	try:P_rotX = doc.FamilyManager.AddParameter("Rotate X",BuiltInParameterGroup.PG_GEOMETRY,ParameterType.Angle,isInstance)
	except:getX = True
	try:P_rotY = doc.FamilyManager.AddParameter("Rotate Y",BuiltInParameterGroup.PG_GEOMETRY,ParameterType.Angle,isInstance)
	except:getY = True	
	try:P_offsetX = doc.FamilyManager.AddParameter("Offset X",BuiltInParameterGroup.PG_GEOMETRY,ParameterType.Length,isInstance)
	except:getXoffset = True
	try:P_offsetY = doc.FamilyManager.AddParameter("Offset Y",BuiltInParameterGroup.PG_GEOMETRY,ParameterType.Length,isInstance)
	except:getYoffset = True
	try:P_offsetZ = doc.FamilyManager.AddParameter("Offset Z",BuiltInParameterGroup.PG_GEOMETRY,ParameterType.Length,isInstance)
	except:getZoffset = True
	
	if getscale == True or getself == True or getX == True or getY == True:
		allparms = doc.FamilyManager.Parameters
		for a in allparms:
			pass
			pname = a.Definition.Name
			if pname == tmpscale and getscale == True:
				P_Scale = a
				if isInstance:
					doc.FamilyManager.MakeInstance(P_Scale)
				else:
					doc.FamilyManager.MakeType(P_Scale)
			if pname == finalscale and getscalenum == True:
				P_ScaleNum = a
				if isInstance:
					doc.FamilyManager.MakeInstance(P_ScaleNum)
				else:
					doc.FamilyManager.MakeType(P_ScaleNum)
			if pname == "Rotate Self" and getself == True:
				P_rotself = a
				if isInstance:
					doc.FamilyManager.MakeInstance(P_rotself)
				else:
					doc.FamilyManager.MakeType(P_rotself)
			if pname == "Rotate X" and getX == True:
				P_rotX = a
				if isInstance:
					doc.FamilyManager.MakeInstance(P_rotX)
				else:
					doc.FamilyManager.MakeType(P_rotX)
			if pname == "Rotate Y" and getY == True:
				P_rotY = a
				if isInstance:
					doc.FamilyManager.MakeInstance(P_rotY)
				else:
					doc.FamilyManager.MakeType(P_rotY)
			if pname == "Offset X" and getXoffset == True:
				P_offsetX = a
				if isInstance:
					doc.FamilyManager.MakeInstance(P_offsetX)
				else:
					doc.FamilyManager.MakeType(P_offsetX)
			if pname == "Offset Y" and getYoffset == True:
				P_offsetY = a
				if isInstance:
					doc.FamilyManager.MakeInstance(P_offsetY)
				else:
					doc.FamilyManager.MakeType(P_offsetY)
			if pname == "Offset Z" and getZoffset == True:
				P_offsetZ = a
				if isInstance:
					doc.FamilyManager.MakeInstance(P_offsetZ)
				else:
					doc.FamilyManager.MakeType(P_offsetZ)
					
	parms = refpt1.GetOrderedParameters()
	for e in parms:
		pname = e.Definition.Name
		if pname == "Rotation Angle":
			rotparm1 = e
		if pname == "Offset":
			offparm1 = e
	
	parms = refpt2.GetOrderedParameters()
	for e in parms:
		pname = e.Definition.Name
		if pname == "Rotation Angle":
			rotparm2 = e
		if pname == "Offset":
			offparm2 = e
			
	parms = refpt3.GetOrderedParameters()
	for e in parms:
		pname = e.Definition.Name
		if pname == "Rotation Angle":
			rotparm3 = e
		if pname == "Offset":
			offparm3 = e
			
	try:doc.FamilyManager.AssociateElementParameterToFamilyParameter(rotparm1,P_rotself)
	except:pass
	try:doc.FamilyManager.AssociateElementParameterToFamilyParameter(rotparm2,P_rotX)
	except:pass
	try:doc.FamilyManager.AssociateElementParameterToFamilyParameter(rotparm3,P_rotY)
	except:pass
	try:doc.FamilyManager.AssociateElementParameterToFamilyParameter(offparm3,P_offsetX)
	except:pass
	try:doc.FamilyManager.AssociateElementParameterToFamilyParameter(offparm2,P_offsetY)
	except:pass
	try:doc.FamilyManager.AssociateElementParameterToFamilyParameter(offparm1,P_offsetZ)
	except:pass
	
	famsymboltoplace = doc.GetElement(FilteredElementCollector(doc).OfCategory(BuiltInCategory.OST_GenericModel).WhereElementIsElementType().FirstElementId())
	reference = refpt3.GetCoordinatePlaneReferenceXZ()
	if not famsymboltoplace.IsActive: famsymboltoplace.Activate()
	placedfam = doc.FamilyCreate.NewFamilyInstance(reference,XYZ.Zero,XYZ.Zero,famsymboltoplace)
	
	parms = famsymboltoplace.GetOrderedParameters()
	for e in parms:
		pname = e.Definition.Name
		if pname == tmpscale:
			scaleparm = e
	try:doc.FamilyManager.AssociateElementParameterToFamilyParameter(scaleparm,P_Scale)
	except:pass
	doc.FamilyManager.Set(P_ScaleNum, 1)
	doc.FamilyManager.SetFormula(P_Scale,finalscale + "*1")
	reordered  = []
	reordered.append(P_ScaleNum)
	reordered.append(P_rotself)
	reordered.append(P_rotX)
	reordered.append(P_rotY)
	reordered.append(P_offsetX)
	reordered.append(P_offsetY)
	reordered.append(P_offsetZ)
	reordered.append(P_Scale)
	ttt = []
	allparms = doc.FamilyManager.Parameters
	for a in allparms:
		na = a.Definition.Name
		if na == tmpscale or na == finalscale or na == "Rotate Self" or na == "Rotate X" or na == "Rotate Y" or na == "Offset X" or na == "Offset Y" or na == "Offset Z":
			pass
		else:
			reordered.append(a)
	doc.FamilyManager.ReorderParameters(List[FamilyParameter](reordered))
	return doc

curves = [x for x in curves if x]

if len(curves) == 0:
	OUT = None
else:
	try:
		name = name + " K-Rig Profile"
		adaptivedoc = initialfamily(fam_path_adaptive,doc,name,"Generic Models",False,curves,False,False,False,False,False,tmpscale)
		genericdoc = initialfamily(fam_path,adaptivedoc,name + " Scalable","Generic Models",False,curves,False,False,False,True,False,tmpscale)
		secondplant = initialfamily(fam_path,genericdoc,name + " Second","Planting",False,curves,True,True,False,False,False,tmpscale)
		seconddoc = genericdoc.EditFamily(secondplant)
		firstplant = initialfamily(fam_path,seconddoc,name + " First","Planting",True,curves,True,True,False,False,False,tmpscale)
		firstdoc = seconddoc.EditFamily(firstplant)
		
		firstdoc.LoadFamily(seconddoc,FamOpt1())
		seconddoc.LoadFamily(genericdoc,FamOpt1())
		genericdoc.LoadFamily(adaptivedoc,FamOpt1())
		genericparams = genericdoc.FamilyManager.Parameters
		plantingelements = genericdoc.GetElement(FilteredElementCollector(genericdoc).OfCategory(BuiltInCategory.OST_Planting).WhereElementIsElementType().FirstElementId())
		for epms in genericparams:
			pname = epms.Definition.Name
			if pname == tmpscale:
				genparm = epms
		
		plantingparams = plantingelements.GetOrderedParameters()
		for e in plantingparams:
			pname = e.Definition.Name
			if pname == "Height":
				plantparm = e
		
		TransactionManager.Instance.ForceCloseTransaction()
		trans1 = Transaction(genericdoc, 'Associate Parameter')
		trans1.Start()
		genericdoc.FamilyManager.AssociateElementParameterToFamilyParameter(plantparm,genparm)
		trans1.Commit()
		genericdoc.LoadFamily(adaptivedoc,FamOpt1())
		TransactionManager.Instance.ForceCloseTransaction()
		trans1 = Transaction(adaptivedoc, 'Working in Adaptive Family')
		trans1.Start()
		foptions = trans1.GetFailureHandlingOptions()
		foptions.SetFailuresPreprocessor(WarnSwallow())
		trans1.SetFailureHandlingOptions(foptions)
		adaptiveop(adaptivedoc,isInstance,tmpscale,finalscale)
		trans1.Commit()
		TransactionManager.Instance.ForceCloseTransaction()
		adaptivefam = adaptivedoc.LoadFamily(doc,FamOpt1())
		firstdoc.Close(False)
		seconddoc.Close(False)
		genericdoc.Close(False)
		adaptivedoc.Close(False)
		
		TransactionManager.Instance.ForceCloseTransaction()
		trans1 = Transaction(doc, 'Refresh Document')
		trans1.Start()
		symbols = adaptivefam.GetFamilySymbolIds().GetEnumerator()
		symbols.MoveNext()
		symbol1 = doc.GetElement(symbols.Current)
		if not symbol1.IsActive: symbol1.Activate()
		doc.Regenerate()
		trans1.Commit()
	except:
		TransactionManager.Instance.ForceCloseTransaction()
		try:firstdoc.Close(False)
		except:pass
		try:seconddoc.Close(False)
		except:pass
		try:genericdoc.Close(False)
		except:pass
		try:adaptivedoc.Close(False)
		except:pass
		symbol1 = None
	OUT = symbol1
# ----------------------------------------
VARFamilyType = Output(python_script)
