# Dynamo custom node K-Section Filled Region.dyf (Dynamo 2.1.0.7500)
# category: Synthesize.Automate.Surface
# K-Section Filled Region

VARSectionView = Input(VARSectionView: var[]..[])
VARFilledRegionCurves = Input(VARFilledRegionCurves: var[]..[])
VARFilledRegionType = Input(VARFilledRegionType: var[]..[])
byCurves = FilledRegion.ByCurves(view=VARSectionView, boundary=VARFilledRegionCurves, regionType=VARFilledRegionType)
isNull = Object.IsNull(obj=byCurves)
filterByBoolMask = List.FilterByBoolMask(list=VARSectionView, mask=isNull)
as_polycurve_bycurves = Custom[AS.[&] PolyCurve.ByCurves](VARcurves=VARFilledRegionCurves)  # Create polycurves from an unordered list of curves.
flatten = List.Flatten(list=as_polycurve_bycurves.VARpolyCurve)
filterByBoolMask_2 = List.FilterByBoolMask(list=flatten, mask=isNull)
curves = PolyCurve.Curves(polyCurve=filterByBoolMask_2.in)
toNurbsCurve = Curve.ToNurbsCurve(curve=curves)
controlPoints = NurbsCurve.ControlPoints(nurbsCurve=toNurbsCurve)
byControlPoints = NurbsCurve.ByControlPoints(points=controlPoints)
byCurves_2 = FilledRegion.ByCurves(view=filterByBoolMask.in, boundary=byControlPoints, regionType=VARFilledRegionType)
create = List.Create(item0=byCurves, item1=byCurves_2)
code_block = CodeBlock { false; }
clean = List.Clean(list=create, preserveIndices=code_block)
flatten_2 = List.Flatten(list=clean)
VARFilledRegion = Output(flatten_2)
