# Dynamo custom node K-Section Lines Prepare.dyf (Dynamo 2.1.0.7500)
# category: Synthesize.Automate.Surface
# K-Section Lines Prepare

VARSurface = Input(VARSurface: var[]..[])
perimeterCurves = Surface.PerimeterCurves(surface=VARSurface)
as_polycurve_bycurves = Custom[AS.[&] PolyCurve.ByCurves](VARcurves=perimeterCurves)  # Create polycurves from an unordered list of curves.
VARrealCurves = Output(as_polycurve_bycurves.VARpolyCurve)
length = Curve.Length(curve=as_polycurve_bycurves.VARpolyCurve)
maximumItem = List.MaximumItem(list=length)
eq = length == maximumItem
filterByBoolMask = List.FilterByBoolMask(list=as_polycurve_bycurves.VARpolyCurve, mask=eq)
firstItem = List.FirstItem(list=filterByBoolMask.in@@L2)
VARPlanes = Input(VARPlanes: var[]..[])
pullOntoPlane = Curve.PullOntoPlane(curve=firstItem, plane=VARPlanes)
as_polycurve_bycurves_2 = Custom[AS.[&] PolyCurve.ByCurves](VARcurves=pullOntoPlane@L1)
flatten = List.Flatten(list=as_polycurve_bycurves_2.VARpolyCurve)
curves = PolyCurve.Curves(polyCurve=flatten)
VARFilledRegionCurves = Output(curves)
VARCropRegionOffset = Input(VARCropRegionOffset: var[]..[])
offset = Curve.Offset(curve=pullOntoPlane, distance=VARCropRegionOffset)
explode = Geometry.Explode(geometry=offset)
as_polycurve_bycurves_3 = Custom[AS.[&] PolyCurve.ByCurves](VARcurves=explode)
flatten_2 = List.Flatten(list=as_polycurve_bycurves_3.VARpolyCurve)
curves_2 = PolyCurve.Curves(polyCurve=flatten_2)
rank = List.Rank(list=curves_2)
normalizeDepth = List.NormalizeDepth(list=curves_2, rank=rank)
length_2 = Curve.Length(curve=curves_2)
startPoint = Curve.StartPoint(curve=curves_2)
endPoint = Curve.EndPoint(curve=curves_2)
byStartPointEndPoint = Line.ByStartPointEndPoint(startPoint=startPoint, endPoint=endPoint)
length_3 = Curve.Length(curve=byStartPointEndPoint)
eq_2 = length_2 == length_3
filterByBoolMask_2 = List.FilterByBoolMask(list=normalizeDepth, mask=eq_2)
VARCropRegionSegmentationDistanceForNonS = Input(VARCropRegionSegmentationDistanceForNonStreightLines: var[]..[])
code_block = CodeBlock { false; }
lines_segmentation_by_distance = Custom[Lines Segmentation By Distance](VARCurves=filterByBoolMask_2.out@L2, VARSegmentationDistance=VARCropRegionSegmentationDistanceForNonS, VARConnectLastToFirst=code_block)  # Lines Segmentation By Distance
mergeByBoolMask = Custom[SP.List.MergeByBoolMask](VARIn=filterByBoolMask_2.in, VAROut=lines_segmentation_by_distance, VARmask=eq_2, lacing=Longest)  # Merge two lists by a boolean mask list. The true count in the mask should be the same as the length of the true list and vice versa for the false list.
as_polycurve_bycurves_4 = Custom[AS.[&] PolyCurve.ByCurves](VARcurves=mergeByBoolMask@L2)
flatten_3 = List.Flatten(list=as_polycurve_bycurves_4.VARpolyCurve)
curves_3 = PolyCurve.Curves(polyCurve=flatten_3)
VARCropRegionCurves = Output(curves_3)
VARSectionViews = Input(VARSectionViews: var[]..[])
VARViewstoCrop = Output(VARSectionViews)
