# Dynamo custom node K-Super Adaptive Paneling.dyf (Dynamo 2.1.0.7500)
# category: Synthesize.Automate.Adaptive
# K-Super Adaptive Paneling

code_block = CodeBlock { 1; }
VARFamilyType = Input(VARFamilyType: var[]..[])
adaptive_family_orientation_type = Custom[Adaptive Family Orientation Type](VARFamilyType=VARFamilyType)  # Adaptive Family Orientation Type
count = List.Count(list=adaptive_family_orientation_type.VARParameterNumbers)
eq = code_block == count
VARReversePlacementDirection = Input(VARReversePlacementDirection: var[]..[])
VARZAlwaysUp = Input(VARZAlwaysUp: var[]..[])
VARCoordinateSystem = Input(VARCoordinateSystem: var[]..[])
VARDegreesZAxis = Input(VARDegreesZAxis: var[]..[])
coordinate_sytem_rotate_by_z = Custom[Coordinate Sytem Rotate By Z Axis](VARcoordinateSystem=VARCoordinateSystem, VARdegrees=VARDegreesZAxis)  # Coordinate Sytem Rotate By Z Axis
empty = List.Empty()
scopeIf = Custom[CW.ScopeIf+](VARtest=VARZAlwaysUp, VARtrue=coordinate_sytem_rotate_by_z, VARfalse=empty)  # A (hopefully) more robust implementation of ScopeIf. Tests a single boolean and returns a value accordingly.
coordinate_system_global_z_then = Custom[Coordinate System Global Z Then Host XY](VARCoordinateSystem=scopeIf)  # Coordinate System Global Z Then Host XY
scopeIf_2 = Custom[CW.ScopeIf+](VARtest=VARZAlwaysUp, VARtrue=coordinate_system_global_z_then, VARfalse=VARCoordinateSystem)
reverse = List.Reverse(list=scopeIf_2@L2)
scopeIf_3 = Custom[CW.ScopeIf+](VARtest=VARReversePlacementDirection, VARtrue=reverse, VARfalse=scopeIf_2)
chop = List.Chop(list=scopeIf_3@L2, lengths=code_block)
code_block_2 = CodeBlock(a=count) { a-1; }
range = Range(end=code_block_2, lacing=Longest)
sublists = List.Sublists(list=scopeIf_3@L2, ranges=range, offset=code_block_2)
count_2 = List.Count(list=sublists@@L2)
eq_2 = count_2@L2 == count
filterByBoolMask = List.FilterByBoolMask(list=sublists, mask=eq_2)
scopeIf_4 = Custom[CW.ScopeIf+](VARtest=eq, VARtrue=chop, VARfalse=filterByBoolMask.in)
VARFlip = Input(VARFlip: var[]..[])
k_adaptive_component_by = Custom[K-Adaptive Component By Coordinate System](VARCoordinateSystem=scopeIf_4, VARFamilyType=VARFamilyType, VARFlip=VARFlip)  # A Better Adaptive Component Placement Method Using Coordinate System
VARAdaptiveComponent = Output(k_adaptive_component_by)
