# Dynamo custom node K-Super Faces Outlines Paneling.dyf (Dynamo 2.1.0.7500)
# category: Synthesize.Automate.Adaptive
# K-Super Quad Master Paneling

VARFamilyType = Input(VARFamilyType: var[]..[])
code_block = CodeBlock { false; true; }
VARRotationDegree = Input(VARRotationDegree: var[]..[])
VARAdaptivePointsOffset = Input(VARAdaptivePointsOffset: var[]..[])
VARSATFile = Input(VARSATFile: var[]..[])
fileExists = FileSystem.FileExists(path=VARSATFile)
python_script = Python(IN[0]=VARSATFile)
# ---------- python_script.python (40 lines) ----------
# Enable Python support and load DesignScript library
# IMPORTANT : ALL DYNAMO DESIGN SCRIPT NODES ARE AS (dg)
import clr
clr.AddReference('ProtoGeometry')
from Autodesk.DesignScript import Geometry as dg

# EXTENSION Enable ToDSType
clr.AddReference('RevitNodes')
import Revit
clr.ImportExtensions(Revit.Elements)

# Enable Revit Elements
from Revit.Elements import *

# EXTENSION Enable Geometry Conversion Methods
clr.ImportExtensions(Revit.GeometryConversion)

# Enable Revit API
clr.AddReference('RevitAPI')
from Autodesk.Revit.DB import *

# Enable DocumentManager and TransactionManager
clr.AddReference('RevitServices')
from RevitServices.Persistence import DocumentManager
from RevitServices.Transactions import TransactionManager

# Enable ICollection List Translate
clr.AddReference("System")
import System.Collections.Generic
from System.Collections.Generic import List

dataEnteringNode = IN
# Use UnwrapElement(IN[0]) When Translating From Dynamo to Revit
file=UnwrapElement(IN[0])
try:
	result = dg.Geometry.ImportFromSAT(file)
except:
	result = []
# Assign your output to the OUT variable.
OUT = result
# ----------------------------------------
explode = Geometry.Explode(geometry=python_script)
code_block_2 = CodeBlock { "Surface"; }
byClassName = Custom[SP.Filter.ByClassName](VARobject=explode, VARclassName=code_block_2)  # Filters a list of objects by the object's class name. Note that Dynamo elements belong to different classes than their Revit counterparts. Use the Object.Class node to check an object's class.
toNurbsSurface = Surface.ToNurbsSurface(surface=byClassName.VARin)
perimeter = Surface.Perimeter(surface=toNurbsSurface)
code_block_3 = CodeBlock { 3; }
round = Math.Round(number=perimeter, digits=code_block_3)
perimeter_2 = Surface.Perimeter(surface=byClassName.VARin)
round_2 = Math.Round(number=perimeter_2, digits=code_block_3)
eq = round == round_2
filterByBoolMask = List.FilterByBoolMask(list=toNurbsSurface, mask=eq)
VARSurfaces = Input(VARSurfaces: var[]..[])
surface_importer = Custom[Surface Importer](VARSurfaces=VARSurfaces)  # Surface Importer Node
surfaces = PolySurface.Surfaces(polySurface=surface_importer)
scopeIf = Custom[CW.ScopeIf+](VARtest=fileExists, VARtrue=filterByBoolMask.in, VARfalse=surfaces)  # A (hopefully) more robust implementation of ScopeIf. Tests a single boolean and returns a value accordingly.
flatten = List.Flatten(list=scopeIf)
perimeterCurves = Surface.PerimeterCurves(surface=flatten)
startPoint = Curve.StartPoint(curve=perimeterCurves)
code_block_4 = CodeBlock { 0.01; }
metersInput = Custom[MetersInput](VARInput=code_block_4)  # MetersInput
pruneDuplicates = Point.PruneDuplicates(points=startPoint, tolerance=metersInput)
code_block_5 = CodeBlock { 0.5; }
pointAtParameter = Surface.PointAtParameter(surface=flatten, u=code_block_5, v=code_block_5)
normalAtPoint = Surface.NormalAtPoint(surface=flatten, point=pointAtParameter)
byOriginNormal = Plane.ByOriginNormal(origin=pointAtParameter, normal=normalAtPoint)
as_pointlist_sortazimuthally = Custom[AS.[&] PointList.SortAzimuthally](VARpoints=pruneDuplicates, VARplane=byOriginNormal)  # Sort points azimuthally (like sorting numbers around a clock face) in a plane. Points are ordered about the origin of the plane, proceeding from the positive x-axis of the plane in a counter-clockwise direction about the plane normal vector.
code_block_6 = CodeBlock { 1; }
chop = List.Chop(list=as_pointlist_sortazimuthally.VARpoints, lengths=code_block_6)
VARFlip = Input(VARFlip: var[]..[])
k_super_quad_paneling = Custom[K-Super Quad Paneling](VARFamilyType=VARFamilyType, VARProceed=code_block.out1, VARRotationDegree=VARRotationDegree, VARAdaptivePointsOffset=VARAdaptivePointsOffset, VARPointsLists=chop, VARSurfaces=flatten, VARFlip=VARFlip, VARFalsePatternTrueAdaptive=code_block.out0)  # K-Super Adaptive Paneling
code_block_7 = CodeBlock { false; }
clean = List.Clean(list=k_super_quad_paneling.VARAdaptiveComponent, preserveIndices=code_block_7)
flatten_2 = List.Flatten(list=clean)
VAROuput = Output(flatten_2)
