# Dynamo custom node K-Super Honeycombs Paneling.dyf (Dynamo 2.1.0.7500)
# category: Synthesize.Automate.Adaptive
# K-Super Honeycombs Paneling

VARTriangularType = Input(VARTriangularType: var[]..[])
VARProceed = Input(VARProceed: var[]..[])
VARRotationDegree = Input(VARRotationDegree: var[]..[])
VARAdaptivePointsOffset = Input(VARAdaptivePointsOffset: var[]..[])
VARU = Input(VARU: var[]..[])
VARV = Input(VARV: var[]..[])
VARSATFile = Input(VARSATFile: var[]..[])
fileExists = FileSystem.FileExists(path=VARSATFile)
python_script = Python(IN[0]=VARSATFile)
# ---------- python_script.python (40 lines) ----------
# Enable Python support and load DesignScript library
# IMPORTANT : ALL DYNAMO DESIGN SCRIPT NODES ARE AS (dg)
import clr
clr.AddReference('ProtoGeometry')
from Autodesk.DesignScript import Geometry as dg

# EXTENSION Enable ToDSType
clr.AddReference('RevitNodes')
import Revit
clr.ImportExtensions(Revit.Elements)

# Enable Revit Elements
from Revit.Elements import *

# EXTENSION Enable Geometry Conversion Methods
clr.ImportExtensions(Revit.GeometryConversion)

# Enable Revit API
clr.AddReference('RevitAPI')
from Autodesk.Revit.DB import *

# Enable DocumentManager and TransactionManager
clr.AddReference('RevitServices')
from RevitServices.Persistence import DocumentManager
from RevitServices.Transactions import TransactionManager

# Enable ICollection List Translate
clr.AddReference("System")
import System.Collections.Generic
from System.Collections.Generic import List

dataEnteringNode = IN
# Use UnwrapElement(IN[0]) When Translating From Dynamo to Revit
file=UnwrapElement(IN[0])
try:
	result = dg.Geometry.ImportFromSAT(file)
except:
	result = []
# Assign your output to the OUT variable.
OUT = result
# ----------------------------------------
explode = Geometry.Explode(geometry=python_script)
code_block = CodeBlock { "Surface"; }
byClassName = Custom[SP.Filter.ByClassName](VARobject=explode, VARclassName=code_block)  # Filters a list of objects by the object's class name. Note that Dynamo elements belong to different classes than their Revit counterparts. Use the Object.Class node to check an object's class.
toNurbsSurface = Surface.ToNurbsSurface(surface=byClassName.VARin)
perimeter = Surface.Perimeter(surface=toNurbsSurface)
code_block_2 = CodeBlock { 3; }
round = Math.Round(number=perimeter, digits=code_block_2)
perimeter_2 = Surface.Perimeter(surface=byClassName.VARin)
round_2 = Math.Round(number=perimeter_2, digits=code_block_2)
eq = round == round_2
filterByBoolMask = List.FilterByBoolMask(list=toNurbsSurface, mask=eq)
VARSurfaces = Input(VARSurfaces: var[]..[])
surface_importer = Custom[Surface Importer](VARSurfaces=VARSurfaces)  # Surface Importer Node
surfaces = PolySurface.Surfaces(polySurface=surface_importer)
scopeIf = Custom[CW.ScopeIf+](VARtest=fileExists, VARtrue=filterByBoolMask.in, VARfalse=surfaces)  # A (hopefully) more robust implementation of ScopeIf. Tests a single boolean and returns a value accordingly.
flatten = List.Flatten(list=scopeIf)
code_block_3 = CodeBlock { true; }
ne = code_block_3 != VARProceed
honeycombs_paneling = Custom[Honeycombs Paneling](VARU=VARU, VARV=VARV, VARSurfaces=flatten, VARShowPolygons=ne)  # Honeycombs Paneling
VARFlip = Input(VARFlip: var[]..[])
code_block_4 = CodeBlock { false; }
k_super_quad_paneling = Custom[K-Super Quad Paneling](VARFamilyType=VARTriangularType, VARProceed=VARProceed, VARRotationDegree=VARRotationDegree, VARAdaptivePointsOffset=VARAdaptivePointsOffset, VARPointsLists=honeycombs_paneling.VARTriangular, VARSurfaces=flatten, VARFlip=VARFlip, VARFalsePatternTrueAdaptive=code_block_4)  # K-Super Adaptive Paneling
code_block_5 = CodeBlock { false; }
clean = List.Clean(list=k_super_quad_paneling.VARAcceptedCoordinateSystems, preserveIndices=code_block_5)
count = List.Count(list=clean@L3)
code_block_6 = CodeBlock { 1; }
gt = count > code_block_6
code_block_7 = CodeBlock { "No Accepted Panels/Adaptive Components"; }
scopeIf_2 = Custom[CW.ScopeIf+](VARtest=gt, VARtrue=count, VARfalse=code_block_7)
VARAcceptedTriangularPanels = Output(scopeIf_2)
clean_2 = List.Clean(list=k_super_quad_paneling.VARRejectedCoordinateSystems, preserveIndices=code_block_5)
count_2 = List.Count(list=clean_2@L3)
gt_2 = count_2 > code_block_6
code_block_8 = CodeBlock { "No Rejected Panels/Adaptive Components"; }
scopeIf_3 = Custom[CW.ScopeIf+](VARtest=gt_2, VARtrue=count_2, VARfalse=code_block_8)
VARRejectedTriangularPanels = Output(scopeIf_3)
VARQuadType = Input(VARQuadType: var[]..[])
code_block_9 = CodeBlock { false; }
k_super_quad_paneling_2 = Custom[K-Super Quad Paneling](VARFamilyType=VARQuadType, VARProceed=VARProceed, VARRotationDegree=VARRotationDegree, VARAdaptivePointsOffset=VARAdaptivePointsOffset, VARPointsLists=honeycombs_paneling.VARQuadrilateral, VARSurfaces=flatten, VARFlip=VARFlip, VARFalsePatternTrueAdaptive=code_block_9)
code_block_10 = CodeBlock { false; }
clean_3 = List.Clean(list=k_super_quad_paneling_2.VARAcceptedCoordinateSystems, preserveIndices=code_block_10)
count_3 = List.Count(list=clean_3@L3)
code_block_11 = CodeBlock { 1; }
gt_3 = count_3 > code_block_11
code_block_12 = CodeBlock { "No Accepted Panels/Adaptive Components"; }
scopeIf_4 = Custom[CW.ScopeIf+](VARtest=gt_3, VARtrue=count_3, VARfalse=code_block_12)
VARAcceptedQuadPanels = Output(scopeIf_4)
clean_4 = List.Clean(list=k_super_quad_paneling_2.VARRejectedCoordinateSystems, preserveIndices=code_block_10)
count_4 = List.Count(list=clean_4@L3)
gt_4 = count_4 > code_block_11
code_block_13 = CodeBlock { "No Rejected Panels/Adaptive Components"; }
scopeIf_5 = Custom[CW.ScopeIf+](VARtest=gt_4, VARtrue=count_4, VARfalse=code_block_13)
VARRejectedQuadPanels = Output(scopeIf_5)
VARHexagonalType = Input(VARHexagonalType: var[]..[])
code_block_14 = CodeBlock { false; }
k_super_quad_paneling_3 = Custom[K-Super Quad Paneling](VARFamilyType=VARHexagonalType, VARProceed=VARProceed, VARRotationDegree=VARRotationDegree, VARAdaptivePointsOffset=VARAdaptivePointsOffset, VARPointsLists=honeycombs_paneling.VARHexagon, VARSurfaces=flatten, VARFlip=VARFlip, VARFalsePatternTrueAdaptive=code_block_14)
code_block_15 = CodeBlock { false; }
clean_5 = List.Clean(list=k_super_quad_paneling_3.VARAcceptedCoordinateSystems, preserveIndices=code_block_15)
count_5 = List.Count(list=clean_5@L3)
code_block_16 = CodeBlock { 1; }
gt_5 = count_5 > code_block_16
code_block_17 = CodeBlock { "No Accepted Panels/Adaptive Components"; }
scopeIf_6 = Custom[CW.ScopeIf+](VARtest=gt_5, VARtrue=count_5, VARfalse=code_block_17)
VARAcceptedHexagonalPanels = Output(scopeIf_6)
clean_6 = List.Clean(list=k_super_quad_paneling_3.VARRejectedCoordinateSystems, preserveIndices=code_block_15)
count_6 = List.Count(list=clean_6@L3)
gt_6 = count_6 > code_block_16
code_block_18 = CodeBlock { "No Rejected Panels/Adaptive Components"; }
scopeIf_7 = Custom[CW.ScopeIf+](VARtest=gt_6, VARtrue=count_6, VARfalse=code_block_18)
VARRejectedHexagonalPanels = Output(scopeIf_7)
code_block_19 = CodeBlock { false; }
clean_7 = List.Clean(list=honeycombs_paneling.VARPolygons, preserveIndices=code_block_19)
flatten_2 = List.Flatten(list=clean_7)
byPatch = Surface.ByPatch(closedCurve=flatten_2)
code_block_20 = CodeBlock { true; }
dynamo_geometry_to_revit = Custom[Dynamo Geometry To Revit Compatibility](VARGeometryOrSat=byPatch, VARPreferImportInstance=code_block_20, VARPreferOneElement=code_block_20)  # Dynamo Geometry To Revit Compatibility
create = List.Create(item0=k_super_quad_paneling.VARAdaptiveComponent, item1=k_super_quad_paneling_2.VARAdaptiveComponent, item2=k_super_quad_paneling_3.VARAdaptiveComponent, item3=dynamo_geometry_to_revit)
code_block_21 = CodeBlock { false; }
clean_8 = List.Clean(list=create, preserveIndices=code_block_21)
flatten_3 = List.Flatten(list=clean_8)
VAROutput = Output(flatten_3)
