# Dynamo custom node K-Super Map Revit Paneling - Auto.dyf (Dynamo 2.1.0.7500)
# category: Synthesize.Automate.Adaptive
# K-Super Map Revit Paneling - Auto

VARPrimaryType = Input(VARPrimaryType: var[]..[])
VARProceed = Input(VARProceed: var[]..[])
VARRotationDegree = Input(VARRotationDegree: var[]..[])
VARAdaptivePointsOffset = Input(VARAdaptivePointsOffset: var[]..[])
VARSATFile = Input(VARSATFile: var[]..[])
fileExists = FileSystem.FileExists(path=VARSATFile)
python_script = Python(IN[0]=VARSATFile)
# ---------- python_script.python (40 lines) ----------
# Enable Python support and load DesignScript library
# IMPORTANT : ALL DYNAMO DESIGN SCRIPT NODES ARE AS (dg)
import clr
clr.AddReference('ProtoGeometry')
from Autodesk.DesignScript import Geometry as dg

# EXTENSION Enable ToDSType
clr.AddReference('RevitNodes')
import Revit
clr.ImportExtensions(Revit.Elements)

# Enable Revit Elements
from Revit.Elements import *

# EXTENSION Enable Geometry Conversion Methods
clr.ImportExtensions(Revit.GeometryConversion)

# Enable Revit API
clr.AddReference('RevitAPI')
from Autodesk.Revit.DB import *

# Enable DocumentManager and TransactionManager
clr.AddReference('RevitServices')
from RevitServices.Persistence import DocumentManager
from RevitServices.Transactions import TransactionManager

# Enable ICollection List Translate
clr.AddReference("System")
import System.Collections.Generic
from System.Collections.Generic import List

dataEnteringNode = IN
# Use UnwrapElement(IN[0]) When Translating From Dynamo to Revit
file=UnwrapElement(IN[0])
try:
	result = dg.Geometry.ImportFromSAT(file)
except:
	result = []
# Assign your output to the OUT variable.
OUT = result
# ----------------------------------------
explode = Geometry.Explode(geometry=python_script)
code_block = CodeBlock { "Surface"; }
byClassName = Custom[SP.Filter.ByClassName](VARobject=explode, VARclassName=code_block)  # Filters a list of objects by the object's class name. Note that Dynamo elements belong to different classes than their Revit counterparts. Use the Object.Class node to check an object's class.
toNurbsSurface = Surface.ToNurbsSurface(surface=byClassName.VARin)
perimeter = Surface.Perimeter(surface=toNurbsSurface)
code_block_2 = CodeBlock { 3; }
round = Math.Round(number=perimeter, digits=code_block_2)
perimeter_2 = Surface.Perimeter(surface=byClassName.VARin)
round_2 = Math.Round(number=perimeter_2, digits=code_block_2)
eq = round == round_2
filterByBoolMask = List.FilterByBoolMask(list=toNurbsSurface, mask=eq)
VARTargetFaces = Input(VARTargetFaces: var[]..[])
surface_importer = Custom[Surface Importer](VARSurfaces=VARTargetFaces)  # Surface Importer Node
surfaces = PolySurface.Surfaces(polySurface=surface_importer)
scopeIf = Custom[CW.ScopeIf+](VARtest=fileExists, VARtrue=filterByBoolMask.in, VARfalse=surfaces)  # A (hopefully) more robust implementation of ScopeIf. Tests a single boolean and returns a value accordingly.
flatten = List.Flatten(list=scopeIf)
VARSourceFamilyType = Input(VARSourceFamilyType: var[]..[])
VARuDivs = Input(VARuDivs: int)
VARvDivs = Input(VARvDivs: int)
VARgridRotation = Input(VARgridRotation: double)
code_block_3 = CodeBlock { true; }
ne = code_block_3 != VARProceed
VARPointsTolerance = Input(VARPointsTolerance: var[]..[])
map_revit_panels = Custom[Map Revit Panels](VARSurfaces=flatten, VARFamilyType=VARSourceFamilyType, VARuDivs=VARuDivs, VARvDivs=VARvDivs, VARgridRotation=VARgridRotation, VARShowPolygons=ne, VARPointsTolerance=VARPointsTolerance)  # Map Revit Panels
VARFlip = Input(VARFlip: var[]..[])
code_block_4 = CodeBlock { false; }
k_super_quad_paneling = Custom[K-Super Quad Paneling](VARFamilyType=VARPrimaryType, VARProceed=VARProceed, VARRotationDegree=VARRotationDegree, VARAdaptivePointsOffset=VARAdaptivePointsOffset, VARPointsLists=map_revit_panels.VARPrimary, VARSurfaces=flatten, VARFlip=VARFlip, VARFalsePatternTrueAdaptive=code_block_4)  # K-Super Adaptive Paneling
code_block_5 = CodeBlock { false; }
clean = List.Clean(list=k_super_quad_paneling.VARAcceptedCoordinateSystems, preserveIndices=code_block_5)
count = List.Count(list=clean@L3)
code_block_6 = CodeBlock { 1; }
gt = count > code_block_6
code_block_7 = CodeBlock { "No Accepted Panels/Adaptive Components"; }
scopeIf_2 = Custom[CW.ScopeIf+](VARtest=gt, VARtrue=count, VARfalse=code_block_7)
VARAcceptedPrimaryPanels = Output(scopeIf_2)
clean_2 = List.Clean(list=k_super_quad_paneling.VARRejectedCoordinateSystems, preserveIndices=code_block_5)
count_2 = List.Count(list=clean_2@L3)
gt_2 = count_2 > code_block_6
code_block_8 = CodeBlock { "No Rejected Panels/Adaptive Components"; }
scopeIf_3 = Custom[CW.ScopeIf+](VARtest=gt_2, VARtrue=count_2, VARfalse=code_block_8)
VARRejectedPrimaryPanels = Output(scopeIf_3)
VARSecondaryType = Input(VARSecondaryType: var[]..[])
code_block_9 = CodeBlock { false; }
k_super_quad_paneling_2 = Custom[K-Super Quad Paneling](VARFamilyType=VARSecondaryType, VARProceed=VARProceed, VARRotationDegree=VARRotationDegree, VARAdaptivePointsOffset=VARAdaptivePointsOffset, VARPointsLists=map_revit_panels.VARSecondary, VARSurfaces=flatten, VARFlip=VARFlip, VARFalsePatternTrueAdaptive=code_block_9)
code_block_10 = CodeBlock { false; }
clean_3 = List.Clean(list=k_super_quad_paneling_2.VARAcceptedCoordinateSystems, preserveIndices=code_block_10)
count_3 = List.Count(list=clean_3@L3)
code_block_11 = CodeBlock { 1; }
gt_3 = count_3 > code_block_11
code_block_12 = CodeBlock { "No Accepted Panels/Adaptive Components"; }
scopeIf_4 = Custom[CW.ScopeIf+](VARtest=gt_3, VARtrue=count_3, VARfalse=code_block_12)
VARAcceptedSecondaryPanels = Output(scopeIf_4)
clean_4 = List.Clean(list=k_super_quad_paneling_2.VARRejectedCoordinateSystems, preserveIndices=code_block_10)
count_4 = List.Count(list=clean_4@L3)
gt_4 = count_4 > code_block_11
code_block_13 = CodeBlock { "No Rejected Panels/Adaptive Components"; }
scopeIf_5 = Custom[CW.ScopeIf+](VARtest=gt_4, VARtrue=count_4, VARfalse=code_block_13)
VARRejectedSecondaryPanels = Output(scopeIf_5)
VARQuinaryType = Input(VARQuinaryType: var[]..[])
code_block_14 = CodeBlock { false; }
k_super_quad_paneling_3 = Custom[K-Super Quad Paneling](VARFamilyType=VARQuinaryType, VARProceed=VARProceed, VARRotationDegree=VARRotationDegree, VARAdaptivePointsOffset=VARAdaptivePointsOffset, VARPointsLists=map_revit_panels.VARQuinary, VARSurfaces=flatten, VARFlip=VARFlip, VARFalsePatternTrueAdaptive=code_block_14)
code_block_15 = CodeBlock { false; }
clean_5 = List.Clean(list=k_super_quad_paneling_3.VARAcceptedCoordinateSystems, preserveIndices=code_block_15)
count_5 = List.Count(list=clean_5@L3)
code_block_16 = CodeBlock { 1; }
gt_5 = count_5 > code_block_16
code_block_17 = CodeBlock { "No Accepted Panels/Adaptive Components"; }
scopeIf_6 = Custom[CW.ScopeIf+](VARtest=gt_5, VARtrue=count_5, VARfalse=code_block_17)
VARAcceptedQuinaryPanels = Output(scopeIf_6)
clean_6 = List.Clean(list=k_super_quad_paneling_3.VARRejectedCoordinateSystems, preserveIndices=code_block_15)
count_6 = List.Count(list=clean_6@L3)
gt_6 = count_6 > code_block_16
code_block_18 = CodeBlock { "No Rejected Panels/Adaptive Components"; }
scopeIf_7 = Custom[CW.ScopeIf+](VARtest=gt_6, VARtrue=count_6, VARfalse=code_block_18)
VARRejectedQuinaryPanels = Output(scopeIf_7)
VARQuaternaryType = Input(VARQuaternaryType: var[]..[])
code_block_19 = CodeBlock { false; }
k_super_quad_paneling_4 = Custom[K-Super Quad Paneling](VARFamilyType=VARQuaternaryType, VARProceed=VARProceed, VARRotationDegree=VARRotationDegree, VARAdaptivePointsOffset=VARAdaptivePointsOffset, VARPointsLists=map_revit_panels.VARQuaternary, VARSurfaces=flatten, VARFlip=VARFlip, VARFalsePatternTrueAdaptive=code_block_19)
code_block_20 = CodeBlock { false; }
clean_7 = List.Clean(list=k_super_quad_paneling_4.VARAcceptedCoordinateSystems, preserveIndices=code_block_20)
count_7 = List.Count(list=clean_7@L3)
code_block_21 = CodeBlock { 1; }
gt_7 = count_7 > code_block_21
code_block_22 = CodeBlock { "No Accepted Panels/Adaptive Components"; }
scopeIf_8 = Custom[CW.ScopeIf+](VARtest=gt_7, VARtrue=count_7, VARfalse=code_block_22)
VARAcceptedQuaternaryPanels = Output(scopeIf_8)
clean_8 = List.Clean(list=k_super_quad_paneling_4.VARRejectedCoordinateSystems, preserveIndices=code_block_20)
count_8 = List.Count(list=clean_8@L3)
gt_8 = count_8 > code_block_21
code_block_23 = CodeBlock { "No Rejected Panels/Adaptive Components"; }
scopeIf_9 = Custom[CW.ScopeIf+](VARtest=gt_8, VARtrue=count_8, VARfalse=code_block_23)
VARRejectedQuaternaryPanels = Output(scopeIf_9)
VARTertiaryType = Input(VARTertiaryType: var[]..[])
code_block_24 = CodeBlock { false; }
k_super_quad_paneling_5 = Custom[K-Super Quad Paneling](VARFamilyType=VARTertiaryType, VARProceed=VARProceed, VARRotationDegree=VARRotationDegree, VARAdaptivePointsOffset=VARAdaptivePointsOffset, VARPointsLists=map_revit_panels.VARTertiary, VARSurfaces=flatten, VARFlip=VARFlip, VARFalsePatternTrueAdaptive=code_block_24)
code_block_25 = CodeBlock { false; }
clean_9 = List.Clean(list=k_super_quad_paneling_5.VARAcceptedCoordinateSystems, preserveIndices=code_block_25)
count_9 = List.Count(list=clean_9@L3)
code_block_26 = CodeBlock { 1; }
gt_9 = count_9 > code_block_26
code_block_27 = CodeBlock { "No Accepted Panels/Adaptive Components"; }
scopeIf_10 = Custom[CW.ScopeIf+](VARtest=gt_9, VARtrue=count_9, VARfalse=code_block_27)
VARAcceptedTertiaryPanels = Output(scopeIf_10)
clean_10 = List.Clean(list=k_super_quad_paneling_5.VARRejectedCoordinateSystems, preserveIndices=code_block_25)
count_10 = List.Count(list=clean_10@L3)
gt_10 = count_10 > code_block_26
code_block_28 = CodeBlock { "No Rejected Panels/Adaptive Components"; }
scopeIf_11 = Custom[CW.ScopeIf+](VARtest=gt_10, VARtrue=count_10, VARfalse=code_block_28)
VARRejectedTertiaryPanels = Output(scopeIf_11)
flatten_2 = List.Flatten(list=map_revit_panels.VARReport)
uniqueItems = List.UniqueItems(list=flatten_2)
VARReport = Output(uniqueItems)
code_block_29 = CodeBlock { false; }
clean_11 = List.Clean(list=map_revit_panels.VARPolygons, preserveIndices=code_block_29)
flatten_3 = List.Flatten(list=clean_11)
byPatch = Surface.ByPatch(closedCurve=flatten_3)
code_block_30 = CodeBlock { true; }
dynamo_geometry_to_revit = Custom[Dynamo Geometry To Revit Compatibility](VARGeometryOrSat=byPatch, VARPreferImportInstance=code_block_30, VARPreferOneElement=code_block_30)  # Dynamo Geometry To Revit Compatibility
create = List.Create(item0=k_super_quad_paneling.VARAdaptiveComponent, item1=k_super_quad_paneling_2.VARAdaptiveComponent, item2=k_super_quad_paneling_5.VARAdaptiveComponent, item3=k_super_quad_paneling_4.VARAdaptiveComponent, item4=k_super_quad_paneling_3.VARAdaptiveComponent, item5=dynamo_geometry_to_revit)
code_block_31 = CodeBlock { false; }
clean_12 = List.Clean(list=create, preserveIndices=code_block_31)
flatten_4 = List.Flatten(list=clean_12)
VAROutput = Output(flatten_4)
