# Dynamo custom node K-Super Quad Paneling Chopped.dyf (Dynamo 2.1.0.7500)
# category: Synthesize.Automate.Adaptive
# K-Super Adaptive Paneling

VARProceed = Input(VARProceed: var[]..[])
VARFalsePatternTrueAdaptive = Input(VARFalsePatternTrueAdaptive: var[]..[])
VARPointsLists = Input(VARPointsLists: var[]..[])
isEmpty = List.IsEmpty(list=VARPointsLists)
empty = List.Empty()
VARFamilyType = Input(VARFamilyType: var[]..[])
scopeIf = Custom[CW.ScopeIf+](VARtest=isEmpty, VARtrue=empty, VARfalse=VARFamilyType)  # A (hopefully) more robust implementation of ScopeIf. Tests a single boolean and returns a value accordingly.
VARFlip = Input(VARFlip: var[]..[])
coordinate_system_smart_flip = Custom[Coordinate System Smart Flip](VARFamilyType=scopeIf, VARFlip=VARFlip)  # Coordinate System Smart Flip
code_block = CodeBlock { 1; }
eq = coordinate_system_smart_flip.VARNumberOfApativePoints == code_block
code_block_2 = CodeBlock { false; }
scopeIf_2 = Custom[CW.ScopeIf+](VARtest=VARFalsePatternTrueAdaptive, VARtrue=eq, VARfalse=code_block_2)
VARAdaptivePointsOffset = Input(VARAdaptivePointsOffset: var[]..[])
VARSurfaces = Input(VARSurfaces: var[]..[])
coordinate_system_adaptive = Custom[Coordinate System Adaptive Surface Prepare](VARAdaptivePointsOffset=VARAdaptivePointsOffset, VARPointsLists=VARPointsLists, VARSurfaces=VARSurfaces, VARFlip=coordinate_system_smart_flip.VARFlipCoordinateSystemBool)  # Coordinate System Adaptive Surface Prepare
code_block_3 = CodeBlock { null; }
scopeIf_3 = Custom[CW.ScopeIf+](VARtest=coordinate_system_smart_flip.VARIsGlobalZThenHostXYBool, VARtrue=coordinate_system_adaptive, VARfalse=code_block_3)
coordinate_system_global_z_then = Custom[Coordinate System Global Z Then Host XY](VARCoordinateSystem=scopeIf_3)  # Coordinate System Global Z Then Host XY
scopeIf_4 = Custom[CW.ScopeIf+](VARtest=coordinate_system_smart_flip.VARIsGlobalZThenHostXYBool, VARtrue=coordinate_system_global_z_then, VARfalse=coordinate_system_adaptive)
VARRotationDegree = Input(VARRotationDegree: var[]..[])
coordinate_sytem_rotate_by_z = Custom[Coordinate Sytem Rotate By Z Axis](VARcoordinateSystem=scopeIf_4, VARdegrees=VARRotationDegree)  # Coordinate Sytem Rotate By Z Axis
code_block_4 = CodeBlock(a=coordinate_system_smart_flip.VARNumberOfApativePoints) { a-1; }
range = Range(end=code_block_4, lacing=Longest)
sublists = List.Sublists(list=coordinate_sytem_rotate_by_z@@L2, ranges=range, offset=code_block_4)
flatten = List.Flatten(list=sublists@L2)
count = List.Count(list=flatten)
count_2 = List.Count(list=sublists)
div = count / count_2
chop = List.Chop(list=flatten, lengths=div)
count_3 = List.Count(list=chop@@L2)
code_block_5 = CodeBlock { 1; }
eq_2 = count_3 == code_block_5
filterByBoolMask = List.FilterByBoolMask(list=chop, mask=eq_2)
count_4 = List.Count(list=coordinate_sytem_rotate_by_z@@L2)
code_block_6 = CodeBlock { 1; }
eq_3 = count_4 == code_block_6
filterByBoolMask_2 = List.FilterByBoolMask(list=coordinate_sytem_rotate_by_z, mask=eq_3)
scopeIf_5 = Custom[CW.ScopeIf+](VARtest=VARFalsePatternTrueAdaptive, VARtrue=filterByBoolMask.out, VARfalse=filterByBoolMask_2.out)
chop_2 = List.Chop(list=scopeIf_5@@L2, lengths=code_block)
count_5 = List.Count(list=scopeIf_5@@L2)
eq_4 = coordinate_system_smart_flip.VARNumberOfApativePoints == count_5
filterByBoolMask_3 = List.FilterByBoolMask(list=scopeIf_5, mask=eq_4)
scopeIf_6 = Custom[CW.ScopeIf+](VARtest=scopeIf_2, VARtrue=chop_2, VARfalse=filterByBoolMask_3.in)
code_block_7 = CodeBlock { null; }
scopeIf_7 = Custom[CW.ScopeIf+](VARtest=VARProceed, VARtrue=scopeIf_6, VARfalse=code_block_7)
code_block_8 = CodeBlock { 1; }
chop_3 = List.Chop(list=scopeIf_7, lengths=code_block_8)
k_adaptive_component_by = Custom[K-Adaptive Component By Coordinate System](VARCoordinateSystem=chop_3, VARFamilyType=scopeIf, VARFlip=coordinate_system_smart_flip.VARFlipParameterBool)  # A Better Adaptive Component Placement Method Using Coordinate System
VARAdaptiveComponent = Output(k_adaptive_component_by)
VARAcceptedCoordinateSystems = Output(scopeIf_6)
VARRejectedCoordinateSystems = Output(filterByBoolMask_3.out)
