# Dynamo custom node K-Super Staggered Paneling.dyf (Dynamo 2.1.0.7500)
# category: Synthesize.Automate.Adaptive
# K-Super Staggered Paneling

VARFamilyType = Input(VARFamilyType: var[]..[])
VARProceed = Input(VARProceed: var[]..[])
VARRotationDegree = Input(VARRotationDegree: var[]..[])
VARAdaptivePointsOffset = Input(VARAdaptivePointsOffset: var[]..[])
VARSATFile = Input(VARSATFile: var[]..[])
fileExists = FileSystem.FileExists(path=VARSATFile)
python_script = Python(IN[0]=VARSATFile)
# ---------- python_script.python (40 lines) ----------
# Enable Python support and load DesignScript library
# IMPORTANT : ALL DYNAMO DESIGN SCRIPT NODES ARE AS (dg)
import clr
clr.AddReference('ProtoGeometry')
from Autodesk.DesignScript import Geometry as dg

# EXTENSION Enable ToDSType
clr.AddReference('RevitNodes')
import Revit
clr.ImportExtensions(Revit.Elements)

# Enable Revit Elements
from Revit.Elements import *

# EXTENSION Enable Geometry Conversion Methods
clr.ImportExtensions(Revit.GeometryConversion)

# Enable Revit API
clr.AddReference('RevitAPI')
from Autodesk.Revit.DB import *

# Enable DocumentManager and TransactionManager
clr.AddReference('RevitServices')
from RevitServices.Persistence import DocumentManager
from RevitServices.Transactions import TransactionManager

# Enable ICollection List Translate
clr.AddReference("System")
import System.Collections.Generic
from System.Collections.Generic import List

dataEnteringNode = IN
# Use UnwrapElement(IN[0]) When Translating From Dynamo to Revit
file=UnwrapElement(IN[0])
try:
	result = dg.Geometry.ImportFromSAT(file)
except:
	result = []
# Assign your output to the OUT variable.
OUT = result
# ----------------------------------------
explode = Geometry.Explode(geometry=python_script)
code_block = CodeBlock { "Surface"; }
byClassName = Custom[SP.Filter.ByClassName](VARobject=explode, VARclassName=code_block)  # Filters a list of objects by the object's class name. Note that Dynamo elements belong to different classes than their Revit counterparts. Use the Object.Class node to check an object's class.
toNurbsSurface = Surface.ToNurbsSurface(surface=byClassName.VARin)
perimeter = Surface.Perimeter(surface=toNurbsSurface)
code_block_2 = CodeBlock { 3; }
round = Math.Round(number=perimeter, digits=code_block_2)
perimeter_2 = Surface.Perimeter(surface=byClassName.VARin)
round_2 = Math.Round(number=perimeter_2, digits=code_block_2)
eq = round == round_2
filterByBoolMask = List.FilterByBoolMask(list=toNurbsSurface, mask=eq)
VARSurfaces = Input(VARSurfaces: var[]..[])
surface_importer = Custom[Surface Importer](VARSurfaces=VARSurfaces)  # Surface Importer Node
surfaces = PolySurface.Surfaces(polySurface=surface_importer)
scopeIf = Custom[CW.ScopeIf+](VARtest=fileExists, VARtrue=filterByBoolMask.in, VARfalse=surfaces)  # A (hopefully) more robust implementation of ScopeIf. Tests a single boolean and returns a value accordingly.
flatten = List.Flatten(list=scopeIf)
VARU = Input(VARU: var[]..[])
VARV = Input(VARV: var[]..[])
VARRotate = Input(VARRotate: bool)
VARFalse4PointsPatternTrue9PointsPattern = Input(VARFalse4PointsPatternTrue9PointsPattern: bool)
code_block_3 = CodeBlock { true; }
ne = VARProceed != code_block_3
lb_lunchbox_staggered_grid_by = Custom[LB.LunchBox Staggered Grid by Face](VARSurface=flatten, VARU=VARU, VARV=VARV, VARRotate=VARRotate, VARFalse4PointsPatternTrue9PointsPattern=VARFalse4PointsPatternTrue9PointsPattern, VARShowPolygons=ne)  # Create a Staggered XYZ grid on a face. The face surface must have an untrimmed UV parameter space.
VARFlip = Input(VARFlip: var[]..[])
code_block_4 = CodeBlock { false; }
k_super_quad_paneling = Custom[K-Super Quad Paneling](VARFamilyType=VARFamilyType, VARProceed=VARProceed, VARRotationDegree=VARRotationDegree, VARAdaptivePointsOffset=VARAdaptivePointsOffset, VARPointsLists=lb_lunchbox_staggered_grid_by.VARPanelPts, VARSurfaces=flatten, VARFlip=VARFlip, VARFalsePatternTrueAdaptive=code_block_4)  # K-Super Adaptive Paneling
code_block_5 = CodeBlock { false; }
clean = List.Clean(list=k_super_quad_paneling.VARAcceptedCoordinateSystems, preserveIndices=code_block_5)
count = List.Count(list=clean@L3)
code_block_6 = CodeBlock { 1; }
gt = count > code_block_6
code_block_7 = CodeBlock { "No Accepted Panels/Adaptive Components"; }
scopeIf_2 = Custom[CW.ScopeIf+](VARtest=gt, VARtrue=count, VARfalse=code_block_7)
VARAcceptedPanels = Output(scopeIf_2)
clean_2 = List.Clean(list=k_super_quad_paneling.VARRejectedCoordinateSystems, preserveIndices=code_block_5)
count_2 = List.Count(list=clean_2@L3)
gt_2 = count_2 > code_block_6
code_block_8 = CodeBlock { "No Rejected Panels/Adaptive Components"; }
scopeIf_3 = Custom[CW.ScopeIf+](VARtest=gt_2, VARtrue=count_2, VARfalse=code_block_8)
VARRejectedPanels = Output(scopeIf_3)
code_block_9 = CodeBlock { false; }
clean_3 = List.Clean(list=lb_lunchbox_staggered_grid_by.VARPolygons, preserveIndices=code_block_9)
flatten_2 = List.Flatten(list=clean_3)
byPatch = Surface.ByPatch(closedCurve=flatten_2)
code_block_10 = CodeBlock { true; }
dynamo_geometry_to_revit = Custom[Dynamo Geometry To Revit Compatibility](VARGeometryOrSat=byPatch, VARPreferImportInstance=code_block_10, VARPreferOneElement=code_block_10)  # Dynamo Geometry To Revit Compatibility
create = List.Create(item0=k_super_quad_paneling.VARAdaptiveComponent, item1=dynamo_geometry_to_revit)
code_block_11 = CodeBlock { false; }
clean_4 = List.Clean(list=create, preserveIndices=code_block_11)
flatten_3 = List.Flatten(list=clean_4)
VAROutput = Output(flatten_3)
