# Dynamo custom node K-Super Triangle Complex Paneling.dyf (Dynamo 2.1.0.7500)
# category: Synthesize.Automate.Adaptive
# K-Super Triangle Complex Paneling

VARTriangleLayingType = Input(VARTriangleLayingType: var[]..[])
VARProceed = Input(VARProceed: var[]..[])
VARRotationDegree = Input(VARRotationDegree: var[]..[])
VARAdaptivePointsOffset = Input(VARAdaptivePointsOffset: var[]..[])
VARSATFile = Input(VARSATFile: string)
fileExists = FileSystem.FileExists(path=VARSATFile)
python_script = Python(IN[0]=VARSATFile)
# ---------- python_script.python (40 lines) ----------
# Enable Python support and load DesignScript library
# IMPORTANT : ALL DYNAMO DESIGN SCRIPT NODES ARE AS (dg)
import clr
clr.AddReference('ProtoGeometry')
from Autodesk.DesignScript import Geometry as dg

# EXTENSION Enable ToDSType
clr.AddReference('RevitNodes')
import Revit
clr.ImportExtensions(Revit.Elements)

# Enable Revit Elements
from Revit.Elements import *

# EXTENSION Enable Geometry Conversion Methods
clr.ImportExtensions(Revit.GeometryConversion)

# Enable Revit API
clr.AddReference('RevitAPI')
from Autodesk.Revit.DB import *

# Enable DocumentManager and TransactionManager
clr.AddReference('RevitServices')
from RevitServices.Persistence import DocumentManager
from RevitServices.Transactions import TransactionManager

# Enable ICollection List Translate
clr.AddReference("System")
import System.Collections.Generic
from System.Collections.Generic import List

dataEnteringNode = IN
# Use UnwrapElement(IN[0]) When Translating From Dynamo to Revit
file=UnwrapElement(IN[0])
try:
	result = dg.Geometry.ImportFromSAT(file)
except:
	result = []
# Assign your output to the OUT variable.
OUT = result
# ----------------------------------------
explode = Geometry.Explode(geometry=python_script)
code_block = CodeBlock { "Surface"; }
byClassName = Custom[SP.Filter.ByClassName](VARobject=explode, VARclassName=code_block)  # Filters a list of objects by the object's class name. Note that Dynamo elements belong to different classes than their Revit counterparts. Use the Object.Class node to check an object's class.
toNurbsSurface = Surface.ToNurbsSurface(surface=byClassName.VARin)
perimeter = Surface.Perimeter(surface=toNurbsSurface)
code_block_2 = CodeBlock { 3; }
round = Math.Round(number=perimeter, digits=code_block_2)
perimeter_2 = Surface.Perimeter(surface=byClassName.VARin)
round_2 = Math.Round(number=perimeter_2, digits=code_block_2)
eq = round == round_2
filterByBoolMask = List.FilterByBoolMask(list=toNurbsSurface, mask=eq)
VARSurfaces = Input(VARSurfaces: var[]..[])
surface_importer = Custom[Surface Importer](VARSurfaces=VARSurfaces)  # Surface Importer Node
surfaces = PolySurface.Surfaces(polySurface=surface_importer)
scopeIf = Custom[CW.ScopeIf+](VARtest=fileExists, VARtrue=filterByBoolMask.in, VARfalse=surfaces)  # A (hopefully) more robust implementation of ScopeIf. Tests a single boolean and returns a value accordingly.
flatten = List.Flatten(list=scopeIf)
version = Custom[CW.Dynamo.Version]()  # Retrieves the version of the active Dynamo application
code_block_3 = CodeBlock(a=version.versionShort) { a[0]; }
toNumber = String.ToNumber(str=code_block_3)
code_block_4 = CodeBlock { 1; }
gt = toNumber > code_block_4
VARU = Input(VARU: int)
VARV = Input(VARV: int)
code_block_5 = CodeBlock(unum=VARU, vnum=VARV) { uvlist = UV.ByCoordinates((0..1..#unum+1)<1>,(0..1..#vnum+1)<2>); }
flatten_2 = List.Flatten(list=code_block_5)
VARshiftRows = Input(VARshiftRows: bool)
VARreverseRowsLaying = Input(VARreverseRowsLaying: bool)
VARreverseRowsStanding = Input(VARreverseRowsStanding: bool)
VARshiftPlacementRowsLaying = Input(VARshiftPlacementRowsLaying: int)
VARshiftPlacementRowsStanding = Input(VARshiftPlacementRowsStanding: int)
VARrotateGridBy90Degrees = Input(VARrotateGridBy90Degrees: bool)
cw_paneling = Custom[CW.Paneling.TriangularFlatMirrored Dynamo 2](VARseq=flatten_2, VARV=VARV, VARshiftRows=VARshiftRows, VARreverseRowsLying=VARreverseRowsLaying, VARreverseRowsStanding=VARreverseRowsStanding, VARshiftPlacementRowsLying=VARshiftPlacementRowsLaying, VARshiftPlacementRowsStanding=VARshiftPlacementRowsStanding, VARrotateGridBy90Degrees=VARrotateGridBy90Degrees)  # Creates groups of points from a list of UVs or XYZs for the placement of triangular (diagrid) panels. The placement pattern can be reversed (boolean) and shifted (integer).
triangularFlatMirrored = Custom[CW.Paneling.TriangularFlatMirrored](VARseq=flatten_2, VARV=VARV, VARshiftRows=VARshiftRows, VARreverseRowsLying=VARreverseRowsLaying, VARreverseRowsStanding=VARreverseRowsStanding, VARshiftPlacementRowsLying=VARshiftPlacementRowsLaying, VARshiftPlacementRowsStanding=VARshiftPlacementRowsStanding, VARrotateGridBy90Degrees=VARrotateGridBy90Degrees)  # Creates groups of points from a list of UVs or XYZs for the placement of triangular (diagrid) panels. The placement pattern can be reversed (boolean) and shifted (integer).
scopeIf_2 = Custom[CW.ScopeIf+](VARtest=gt, VARtrue=cw_paneling.VARrowsLying, VARfalse=triangularFlatMirrored.VARrowsLying)
U = UV.U(uV=scopeIf_2)
V = UV.V(uV=scopeIf_2)
pointAtParameter = Surface.PointAtParameter(surface=flatten@L1, u=U, v=V)
VARFlip = Input(VARFlip: var[]..[])
code_block_6 = CodeBlock { false; }
k_super_quad_paneling = Custom[K-Super Quad Paneling](VARFamilyType=VARTriangleLayingType, VARProceed=VARProceed, VARRotationDegree=VARRotationDegree, VARAdaptivePointsOffset=VARAdaptivePointsOffset, VARPointsLists=pointAtParameter, VARSurfaces=flatten, VARFlip=VARFlip, VARFalsePatternTrueAdaptive=code_block_6)  # K-Super Adaptive Paneling
code_block_7 = CodeBlock { false; }
clean = List.Clean(list=k_super_quad_paneling.VARAcceptedCoordinateSystems, preserveIndices=code_block_7)
count = List.Count(list=clean@L3)
code_block_8 = CodeBlock { 1; }
gt_2 = count > code_block_8
code_block_9 = CodeBlock { "No Accepted Panels/Adaptive Components"; }
scopeIf_3 = Custom[CW.ScopeIf+](VARtest=gt_2, VARtrue=count, VARfalse=code_block_9)
VARAcceptedLayingPanels = Output(scopeIf_3)
clean_2 = List.Clean(list=k_super_quad_paneling.VARRejectedCoordinateSystems, preserveIndices=code_block_7)
count_2 = List.Count(list=clean_2@L3)
gt_3 = count_2 > code_block_8
code_block_10 = CodeBlock { "No Rejected Panels/Adaptive Components"; }
scopeIf_4 = Custom[CW.ScopeIf+](VARtest=gt_3, VARtrue=count_2, VARfalse=code_block_10)
VARRejectedLayingPanels = Output(scopeIf_4)
VARTriangleStandingType = Input(VARTriangleStandingType: var[]..[])
scopeIf_5 = Custom[CW.ScopeIf+](VARtest=gt, VARtrue=cw_paneling.VARrowsStanding, VARfalse=triangularFlatMirrored.VARrowsStanding)
U_2 = UV.U(uV=scopeIf_5)
V_2 = UV.V(uV=scopeIf_5)
pointAtParameter_2 = Surface.PointAtParameter(surface=flatten@L1, u=U_2, v=V_2)
code_block_11 = CodeBlock { false; }
k_super_quad_paneling_2 = Custom[K-Super Quad Paneling](VARFamilyType=VARTriangleStandingType, VARProceed=VARProceed, VARRotationDegree=VARRotationDegree, VARAdaptivePointsOffset=VARAdaptivePointsOffset, VARPointsLists=pointAtParameter_2, VARSurfaces=flatten, VARFlip=VARFlip, VARFalsePatternTrueAdaptive=code_block_11)
code_block_12 = CodeBlock { false; }
clean_3 = List.Clean(list=k_super_quad_paneling_2.VARAcceptedCoordinateSystems, preserveIndices=code_block_12)
count_3 = List.Count(list=clean_3@L3)
code_block_13 = CodeBlock { 1; }
gt_4 = count_3 > code_block_13
code_block_14 = CodeBlock { "No Accepted Panels/Adaptive Components"; }
scopeIf_6 = Custom[CW.ScopeIf+](VARtest=gt_4, VARtrue=count_3, VARfalse=code_block_14)
VARAcceptedStandingPanels = Output(scopeIf_6)
clean_4 = List.Clean(list=k_super_quad_paneling_2.VARRejectedCoordinateSystems, preserveIndices=code_block_12)
count_4 = List.Count(list=clean_4@L3)
gt_5 = count_4 > code_block_13
code_block_15 = CodeBlock { "No Rejected Panels/Adaptive Components"; }
scopeIf_7 = Custom[CW.ScopeIf+](VARtest=gt_5, VARtrue=count_4, VARfalse=code_block_15)
VARRejectedStandingPanels = Output(scopeIf_7)
VARTriangleLayingCornersType = Input(VARTriangleLayingCornersType: var[]..[])
scopeIf_8 = Custom[CW.ScopeIf+](VARtest=gt, VARtrue=cw_paneling.VARleftCornersLying, VARfalse=triangularFlatMirrored.VARleftCornersLying)
scopeIf_9 = Custom[CW.ScopeIf+](VARtest=gt, VARtrue=cw_paneling.VARrightCornersLying, VARfalse=triangularFlatMirrored.VARrightCornersLying)
join = List.Join(list0=scopeIf_8, list1=scopeIf_9)
U_3 = UV.U(uV=join)
V_3 = UV.V(uV=join)
pointAtParameter_3 = Surface.PointAtParameter(surface=flatten@L1, u=U_3, v=V_3)
code_block_16 = CodeBlock { false; }
k_super_quad_paneling_3 = Custom[K-Super Quad Paneling](VARFamilyType=VARTriangleLayingCornersType, VARProceed=VARProceed, VARRotationDegree=VARRotationDegree, VARAdaptivePointsOffset=VARAdaptivePointsOffset, VARPointsLists=pointAtParameter_3, VARSurfaces=flatten, VARFlip=VARFlip, VARFalsePatternTrueAdaptive=code_block_16)
code_block_17 = CodeBlock { false; }
clean_5 = List.Clean(list=k_super_quad_paneling_3.VARAcceptedCoordinateSystems, preserveIndices=code_block_17)
count_5 = List.Count(list=clean_5@L3)
code_block_18 = CodeBlock { 1; }
gt_6 = count_5 > code_block_18
code_block_19 = CodeBlock { "No Accepted Panels/Adaptive Components"; }
scopeIf_10 = Custom[CW.ScopeIf+](VARtest=gt_6, VARtrue=count_5, VARfalse=code_block_19)
VARAcceptedLayingCornerPanels = Output(scopeIf_10)
clean_6 = List.Clean(list=k_super_quad_paneling_3.VARRejectedCoordinateSystems, preserveIndices=code_block_17)
count_6 = List.Count(list=clean_6@L3)
gt_7 = count_6 > code_block_18
code_block_20 = CodeBlock { "No Rejected Panels/Adaptive Components"; }
scopeIf_11 = Custom[CW.ScopeIf+](VARtest=gt_7, VARtrue=count_6, VARfalse=code_block_20)
VARRejectedLayingCornerPanels = Output(scopeIf_11)
VARTriangleStandingCornersType = Input(VARTriangleStandingCornersType: var[]..[])
scopeIf_12 = Custom[CW.ScopeIf+](VARtest=gt, VARtrue=cw_paneling.VARleftCornersStanding, VARfalse=triangularFlatMirrored.VARleftCornersStanding)
scopeIf_13 = Custom[CW.ScopeIf+](VARtest=gt, VARtrue=cw_paneling.VARrightCornersStanding, VARfalse=triangularFlatMirrored.VARrightCornersStanding)
join_2 = List.Join(list0=scopeIf_12, list1=scopeIf_13)
U_4 = UV.U(uV=join_2)
V_4 = UV.V(uV=join_2)
pointAtParameter_4 = Surface.PointAtParameter(surface=flatten@L1, u=U_4, v=V_4)
code_block_21 = CodeBlock { false; }
k_super_quad_paneling_4 = Custom[K-Super Quad Paneling](VARFamilyType=VARTriangleStandingCornersType, VARProceed=VARProceed, VARRotationDegree=VARRotationDegree, VARAdaptivePointsOffset=VARAdaptivePointsOffset, VARPointsLists=pointAtParameter_4, VARSurfaces=flatten, VARFlip=VARFlip, VARFalsePatternTrueAdaptive=code_block_21)
code_block_22 = CodeBlock { false; }
clean_7 = List.Clean(list=k_super_quad_paneling_4.VARAcceptedCoordinateSystems, preserveIndices=code_block_22)
count_7 = List.Count(list=clean_7@L3)
code_block_23 = CodeBlock { 1; }
gt_8 = count_7 > code_block_23
code_block_24 = CodeBlock { "No Accepted Panels/Adaptive Components"; }
scopeIf_14 = Custom[CW.ScopeIf+](VARtest=gt_8, VARtrue=count_7, VARfalse=code_block_24)
VARAcceptedStandingCornerPanels = Output(scopeIf_14)
clean_8 = List.Clean(list=k_super_quad_paneling_4.VARRejectedCoordinateSystems, preserveIndices=code_block_22)
count_8 = List.Count(list=clean_8@L3)
gt_9 = count_8 > code_block_23
code_block_25 = CodeBlock { "No Rejected Panels/Adaptive Components"; }
scopeIf_15 = Custom[CW.ScopeIf+](VARtest=gt_9, VARtrue=count_8, VARfalse=code_block_25)
VARRejectedStandingCornerPanels = Output(scopeIf_15)
code_block_26 = CodeBlock { true; }
ne = VARProceed != code_block_26
empty = List.Empty()
scopeIf_16 = Custom[CW.ScopeIf+](VARtest=ne, VARtrue=pointAtParameter, VARfalse=empty)
polygon_bypoints_fixer = Custom[Polygon.ByPoints Fixer](VARpoints=scopeIf_16)  # Polygon.ByPoints Fixer
empty_2 = List.Empty()
scopeIf_17 = Custom[CW.ScopeIf+](VARtest=ne, VARtrue=pointAtParameter_2, VARfalse=empty_2)
polygon_bypoints_fixer_2 = Custom[Polygon.ByPoints Fixer](VARpoints=scopeIf_17)
empty_3 = List.Empty()
scopeIf_18 = Custom[CW.ScopeIf+](VARtest=ne, VARtrue=pointAtParameter_3, VARfalse=empty_3)
polygon_bypoints_fixer_3 = Custom[Polygon.ByPoints Fixer](VARpoints=scopeIf_18)
empty_4 = List.Empty()
scopeIf_19 = Custom[CW.ScopeIf+](VARtest=ne, VARtrue=pointAtParameter_4, VARfalse=empty_4)
polygon_bypoints_fixer_4 = Custom[Polygon.ByPoints Fixer](VARpoints=scopeIf_19)
create = List.Create(item0=polygon_bypoints_fixer, item1=polygon_bypoints_fixer_2, item2=polygon_bypoints_fixer_3, item3=polygon_bypoints_fixer_4)
code_block_27 = CodeBlock { false; }
clean_9 = List.Clean(list=create, preserveIndices=code_block_27)
flatten_3 = List.Flatten(list=clean_9)
python_null_2_empty = Custom[Python Null 2 Empty](VARIN=flatten_3)  # Python Null 2 Empty
byPatch = Surface.ByPatch(closedCurve=python_null_2_empty)
code_block_28 = CodeBlock { true; }
dynamo_geometry_to_revit = Custom[Dynamo Geometry To Revit Compatibility](VARGeometryOrSat=byPatch, VARPreferImportInstance=code_block_28, VARPreferOneElement=code_block_28)  # Dynamo Geometry To Revit Compatibility
create_2 = List.Create(item0=k_super_quad_paneling.VARAdaptiveComponent, item1=k_super_quad_paneling_2.VARAdaptiveComponent, item2=k_super_quad_paneling_3.VARAdaptiveComponent, item3=k_super_quad_paneling_4.VARAdaptiveComponent, item4=dynamo_geometry_to_revit)
code_block_29 = CodeBlock { false; }
clean_10 = List.Clean(list=create_2, preserveIndices=code_block_29)
flatten_4 = List.Flatten(list=clean_10)
VAROutput = Output(flatten_4)
