# Dynamo custom node LB.LunchBox Diamond Grid by Face.dyf (Dynamo 2.1.0.7500)
# category: Synthesize.Packages.LunchBox.Archive.Geometry.Panel
# Create a Diamond XYZ grid on a face.  The face surface must have an untrimmed UV parameter space.

VARSurface = Input(VARSurface: var[]..[])
VARU = Input(VARU: var[]..[])
lb_lunchbox_list_matcher = Custom[LB.LunchBox List Matcher](VARListA=VARSurface, VARListB=VARU)  # Compares a List A against a List B and matches length of List A. If ListA > ListB, ListB will be extended. If ListA < ListB, ListB will be truncated.
VARV = Input(VARV: var[]..[])
lb_lunchbox_list_matcher_2 = Custom[LB.LunchBox List Matcher](VARListA=VARSurface, VARListB=VARV)
python_script = Python(IN[0]=lb_lunchbox_list_matcher.VARListA, IN[1]=lb_lunchbox_list_matcher.VARMatchListB, IN[2]=lb_lunchbox_list_matcher_2.VARMatchListB)
# ---------- python_script.python (95 lines) ----------
#Copyright(c) 2014, Nathan Miller
# The Proving Ground, http://theprovingground.org

import clr
clr.AddReference('ProtoGeometry')
from Autodesk.DesignScript.Geometry import *

# Panel division class
class PanelDivision:
	
	# divide surface
	def DiamondDivision(self, srf, udiv, vdiv):
		ustep = 1.0/udiv
		vstep = 1.0/vdiv
		
		quads = []
		polys = []
		panels = []
		for i in range(0,int(udiv+1)):
			for j in range(0,int(vdiv+1)):
				if (i+j)%2 == 0:
					ptA = srf.PointAtParameter(0,0)
					ptB = srf.PointAtParameter(0,0)
					ptC = srf.PointAtParameter(0,0)
					ptD = srf.PointAtParameter(0,0)
			
					if i>0:
						ptA = srf.PointAtParameter((i-1)*ustep,j*vstep)
					else:
						ptB = srf.PointAtParameter(i*ustep,j*vstep)
				
					if j>0:
						ptB = srf.PointAtParameter(i*ustep,(j-1)*vstep)
					else:
						ptB = srf.PointAtParameter(i*ustep,j*vstep)
					
					if i<udiv:
						ptC = srf.PointAtParameter((i+1)*ustep,j*vstep)
					else:
						ptC = srf.PointAtParameter(i*ustep,j*vstep)
				
					if j<=(vdiv -1):
						ptD = srf.PointAtParameter(i*ustep,(j+1)*vstep)
					else:
						ptD = srf.PointAtParameter(i*ustep,j*vstep)
					
					if i>0 and j>0 and i<udiv and j<=(vdiv-1):
						quad = []
						#Append to quad
						quad.append(ptA)
						quad.append(ptB)
						quad.append(ptC)
						quad.append(ptD)
						#Append quads
						quads.append(quad)
					
						#polygons
						#poly = Polygon.ByPoints(quad)
						#polys.append(poly)
			
						#panels
						#panel = Surface.ByPerimeterPoints(quad)
						#panels.append(panel)
		self.quads = quads
		#self.polys = polys
		#self.panels = panels

#Main code
srf = IN[0]
udiv = IN[1]
vdiv = IN[2]

quads = []
#polys = []
#panels = []

for k in range(0, len(srf)):
	s = srf[k]
	u = udiv[k]
	v = vdiv[k]
			
	divide = PanelDivision()
	divide.DiamondDivision(s,u,v)
					
	quads.append(divide.quads)
	#panels.append(divide.panels)
	#polys.append(divide.polys)
		
output = []
output.append(quads)
#output.append(polys)
#output.append(panels)

#Assign your output to the OUT variable
OUT = output
# ----------------------------------------
number = DoubleInput(0)  # graph input
getItemAtIndex = List.GetItemAtIndex(list=python_script, index=number)
VARAPanelPts = Output(getItemAtIndex)
python_script_2 = Python(IN[0]=lb_lunchbox_list_matcher.VARListA, IN[1]=lb_lunchbox_list_matcher.VARMatchListB, IN[2]=lb_lunchbox_list_matcher_2.VARMatchListB)
# ---------- python_script_2.python (217 lines) ----------
# Nathan Miller, 2013
# The Proving Ground, http://theprovingground.org

import clr
clr.AddReference('ProtoGeometry')
from Autodesk.DesignScript.Geometry import *


# Panel division class
class PanelDivision:
	
	# divide surface
	def DiamondEdgeDivision(self, srf, udiv, vdiv):
		ustep = 1.0/udiv
		vstep = 1.0/vdiv
		
		quads = []
		polys = []
		panels = []
		for i in range(0,int(udiv+1)):
			for j in range(0,int(vdiv+1)):
				if (i+j)%2 == 0:
					ptA = srf.PointAtParameter(0,0)
					ptB = srf.PointAtParameter(0,0)
					ptC = srf.PointAtParameter(0,0)
					ptD = srf.PointAtParameter(0,0)
				
					if i>0:
						ptA = srf.PointAtParameter((i-1)*ustep,j*vstep)
					else:
						ptB = srf.PointAtParameter(i*ustep,j*vstep)
					
					if j>0:
						ptB = srf.PointAtParameter(i*ustep,(j-1)*vstep)
					else:
						ptB = srf.PointAtParameter(i*ustep,j*vstep)
						
					if i<udiv:
						ptC = srf.PointAtParameter((i+1)*ustep,j*vstep)
					else:
						ptC = srf.PointAtParameter(i*ustep,j*vstep)
					
					if j<=(vdiv -1):
						ptD = srf.PointAtParameter(i*ustep,(j+1)*vstep)
					else:
						ptD = srf.PointAtParameter(i*ustep,j*vstep)
						
					if i>0 and j>0 and i<udiv and j<vdiv:
						quad = []
					else:
						if i==0 and j==0:
							quad = []
							#Append to quad
							quad.append(ptB)
							quad.append(ptC)
							quad.append(ptD)
							#Append quads
							quads.append(quad)
							
							#polygons
							poly = Polygon.ByPoints(quad)
							polys.append(poly)
				
							#panels
							panel = Surface.ByPerimeterPoints(quad)
							panels.append(panel)
							
						if i==0 and j==vdiv:
							quad = []
							#Append to quad
							quad.append(ptB)
							quad.append(ptC)
							quad.append(ptD)
							#Append quads
							quads.append(quad)
							
							#polygons
							poly = Polygon.ByPoints(quad)
							polys.append(poly)
				
							#panels
							panel = Surface.ByPerimeterPoints(quad)
							panels.append(panel)
							
						if i==udiv and j==0:
							quad = []
							#Append to quad
							quad.append(ptC)
							quad.append(ptD)
							quad.append(ptA)
							#Append quads
							quads.append(quad)
							
							#polygons
							poly = Polygon.ByPoints(quad)
							polys.append(poly)
				
							#panels
							panel = Surface.ByPerimeterPoints(quad)
							panels.append(panel)
						
						if i==udiv and j==vdiv:
							quad = []
							#Append to quad
							quad.append(ptA)
							quad.append(ptB)
							quad.append(ptC)
							#Append quads
							quads.append(quad)
											
							#polygons
							poly = Polygon.ByPoints(quad)
							polys.append(poly)
				
							#panels
							panel = Surface.ByPerimeterPoints(quad)
							panels.append(panel)
						
						if i == 0 and j > 0 and j < vdiv:
							quad = []
							#Append to quad
							quad.append(ptB)
							quad.append(ptC)
							quad.append(ptD)
							#Append quads
							quads.append(quad)
												
							#polygons
							poly = Polygon.ByPoints(quad)
							polys.append(poly)
				
							#panels
							panel = Surface.ByPerimeterPoints(quad)
							panels.append(panel)
							
						if i == udiv and j > 0 and j < vdiv:
							quad = []
							#Append to quad
							quad.append(ptA)
							quad.append(ptB)
							quad.append(ptD)
							#Append quads
							quads.append(quad)
												
							#polygons
							poly = Polygon.ByPoints(quad)
							polys.append(poly)
				
							#panels
							panel = Surface.ByPerimeterPoints(quad)
							panels.append(panel)
							
						if j == 0 and i > 0 and i < udiv:
							quad = []
							#Append to quad
							quad.append(ptA)
							quad.append(ptC)
							quad.append(ptD)
							#Append quads
							quads.append(quad)
												
							#polygons
							poly = Polygon.ByPoints(quad)
							polys.append(poly)
				
							#panels
							panel = Surface.ByPerimeterPoints(quad)
							panels.append(panel)
							
						if j == vdiv and i > 0 and i < udiv:
							quad = []
							#Append to quad
							quad.append(ptA)
							quad.append(ptB)
							quad.append(ptC)
							#Append quads
							quads.append(quad)
												
							#polygons
							poly = Polygon.ByPoints(quad)
							polys.append(poly)
				
							#panels
							panel = Surface.ByPerimeterPoints(quad)
							panels.append(panel)
		self.panels = panels
		self.quads = quads
		self.polys = polys

#Main code
srf = IN[0]
udiv = IN[1]
vdiv = IN[2]

quads = []
polys = []
panels = []

for k in range(0, len(srf)):
	s = srf[k]
	u = udiv[k]
	v = vdiv[k]
			
	divide = PanelDivision()
	divide.DiamondEdgeDivision(s,u,v)
					
	quads.append(divide.quads)
	panels.append(divide.panels)
	polys.append(divide.polys)
	
output = []
output.append(quads)
output.append(polys)
output.append(panels)

#Assign your output to the OUT variable
OUT = output
# ----------------------------------------
number_2 = DoubleInput(0)  # graph input
getItemAtIndex_2 = List.GetItemAtIndex(list=python_script_2, index=number_2)
VARBPanelsPts = Output(getItemAtIndex_2)
VARShowPolygons = Input(VARShowPolygons: bool = false)
empty = List.Empty()
scopeIf = Custom[CW.ScopeIf+](VARtest=VARShowPolygons, VARtrue=getItemAtIndex, VARfalse=empty)  # A (hopefully) more robust implementation of ScopeIf. Tests a single boolean and returns a value accordingly.
byPoints = Polygon.ByPoints(points=scopeIf)
VARAPolygons = Output(byPoints)
scopeIf_2 = Custom[CW.ScopeIf+](VARtest=VARShowPolygons, VARtrue=getItemAtIndex_2, VARfalse=empty)
byPoints_2 = Polygon.ByPoints(points=scopeIf_2)
VARBPolygons = Output(byPoints_2)
