# Dynamo custom node LB.LunchBox List Matcher.dyf (Dynamo 2.1.0.7500)
# category: Synthesize.Packages.LunchBox.Archive.Format
# Compares a List A against a List B and matches length of List A.  If ListA > ListB, ListB will be extended.  If ListA < ListB, ListB will be truncated.

VARListA = Input(VARListA: var[]..[])
VARListB = Input(VARListB: var[]..[])
python_script = Python(IN[0]=VARListA, IN[1]=VARListB)
# ---------- python_script.python (46 lines) ----------
import clr
clr.AddReference('ProtoGeometry')
from Autodesk.DesignScript.Geometry import *

#The inputs to this node will be stored as a list in the IN variable.
A = IN[0]
B = IN[1]

listA = []
listB = []

#convert lists
if hasattr(A, "__iter__"):
	for i in range(0,len(A)):
		listA.append(A[i])
else:
	listA.append(A)
	
if hasattr(B, "__iter__"):
	for i in range(0,len(B)):
		listB.append(B[i])
else:
	listB.append(B)

# matched lists
lists = []

# if list A is larger than B, replicate the remaining digits of B
if len(listA) > len(listB):	
	dif = len(listA) - len(listB)
	for i in range(0,dif):
		listB.append(listB[len(listB)-1])
# if list B is larger than A, remove the remaining digits of B
elif len(listB) > len(listA):
	dif = len(listA) - len(listB)
	listC = []
	for i in range(0,len(listA)):
		listC.append(listB[i])
	listB = listC
		
lists.append(listA)
lists.append(listB)


#Assign your output to the OUT variable
OUT = lists
# ----------------------------------------
number = DoubleInput(0)  # graph input
getItemAtIndex = List.GetItemAtIndex(list=python_script, index=number)
VARListA_2 = Output(getItemAtIndex)  # "VARListA"
number_2 = DoubleInput(1)  # graph input
getItemAtIndex_2 = List.GetItemAtIndex(list=python_script, index=number_2)
VARMatchListB = Output(getItemAtIndex_2)
