# Dynamo custom node LB.LunchBox Random Numbers.dyf (Dynamo 2.1.0.7500)
# category: Synthesize.Packages.LunchBox.Math.Random
# Generates a list of Random numbers using a domain, amount, and seed.

VARMin = Input(VARMin: var[]..[])
VARMax = Input(VARMax: var[]..[])
VARAmount = Input(VARAmount: var[]..[])
code_block = CodeBlock { 2; }
add = VARAmount + code_block
VARSeed = Input(VARSeed: var[]..[])
python_script = Python(IN[0]=VARMin, IN[1]=VARMax, IN[2]=add, IN[3]=VARSeed)
# ---------- python_script.python (42 lines) ----------
#Copyright(c) 2014, Nathan Miller
# The Proving Ground, http://theprovingground.org

import clr
clr.AddReference('ProtoGeometry')
from Autodesk.DesignScript.Geometry import *
import System

min = IN[0]
max = IN[1]
num = IN[2]
seed = IN[3]

dmin = min
dmax = max
drange = dmax - dmin

random = System.Random(seed)

# Generate some random floats
list = []
for i in range(0,int(num)):
	rand = random.NextDouble()
	list.append(rand)

# Remap numbers
l = []
for i in range(0,len(list)):
	l.append(list[i])

l.sort()
listMin = l[0]
listMax = l[(len(list)-1)]
listRange = listMax-listMin

mapped = []
for i in range(0,len(list)):
	scaled = dmin + (((list[i] - listMin) / listRange) * drange)
	mapped.append(scaled)

#Assign your output to the OUT variable
OUT = mapped
# ----------------------------------------
python_script_2 = Python(IN[0]=VARMin, IN[1]=VARMax, IN[2]=python_script)
# ---------- python_script_2.python (44 lines) ----------
import clr
clr.AddReference('ProtoGeometry')
from Autodesk.DesignScript.Geometry import *
#The inputs to this node will be stored as a list in the IN variables.

result = []

# list with integer elements
list = IN[2]
# number (n) to be removed
n = IN[0]
m = IN[1]

i=0 #loop counter
length = len(list)  #list length 
while(i<length):
	if(list[i]==n):
		list.remove (list[i])
		# as an element is removed	
		# so decrease the length by 1	
		length = length -1  
		# run loop again to check element							
		# at same index, when item removed 
		# next item will shift to the left 
		continue
	i = i+1


i=0 #loop counter
length = len(list)  #list length 
while(i<length):
	if(list[i]==m):
		list.remove (list[i])
		# as an element is removed	
		# so decrease the length by 1	
		length = length -1  
		# run loop again to check element							
		# at same index, when item removed 
		# next item will shift to the left 
		continue
	i = i+1

#Assign your output to the OUT variable.
OUT = list
# ----------------------------------------
VARRandomList = Output(python_script_2)
