# Dynamo custom node LB.LunchBox Room Element Collector.dyf (Dynamo 2.1.0.7500)
# category: Synthesize.Packages.LunchBox.Revit.Elements
# Collects rooms from the Revit document

VARToggle = Input(VARToggle: var[]..[])
python_script = Python(IN[0]=VARToggle)
# ---------- python_script.python (108 lines) ----------
#Copyright(c) 2015, Nathan Miller
# The Proving Ground, http://theprovingground.org

import clr

# Import RevitAPI
clr.AddReference("RevitAPI")
import Autodesk
from Autodesk.Revit.DB import *

# Import DocumentManager and TransactionManager
clr.AddReference("RevitServices")
import RevitServices
from RevitServices.Persistence import DocumentManager
from RevitServices.Transactions import TransactionManager

# Import ToDSType(bool) extension method
clr.AddReference("RevitNodes")
import Revit
clr.ImportExtensions(Revit.Elements)
clr.ImportExtensions(Revit.GeometryConversion)

import clr
clr.AddReference('ProtoGeometry')
from Autodesk.DesignScript.Geometry import *

#The input to this node will be stored in the IN[0] variable.

doc =  DocumentManager.Instance.CurrentDBDocument
app =  DocumentManager.Instance.CurrentUIApplication.Application

toggle = IN[0]

output = []
rooms = []
names = []
numbers = []
areas = []
levels = []
boundaries = []
locations = []
elementids = []
uniqueids = []

if toggle == True:

	collector = FilteredElementCollector(doc)
	collector.OfCategory(BuiltInCategory.OST_Rooms)
 
	famtypeitr = collector.GetElementIdIterator()
	famtypeitr.Reset()


	for item in famtypeitr:
		elmID = item
		eleminst = doc.GetElement(elmID)
    
		#print eleminst
		if eleminst.Area > 0:
			room = eleminst
			roomname = ''
			for p in room.Parameters:
				if p.Definition.Name == 'Name':		
					roomname = p.AsString()
				if p.Definition.Name == 'Level':			
					level = p.AsValueString()
					if (level is None):
						level = p.AsString()
					
			number = eleminst.Number
			area = eleminst.Area
			
			location = eleminst.Location.Point.ToPoint()
			elementid = eleminst.Id.ToString()
			uniqueid = eleminst.UniqueId
    	
			boptions = Autodesk.Revit.DB.SpatialElementBoundaryOptions()
			boundsegs = room.GetBoundarySegments(boptions)
			boundcurves = []
			for bound in boundsegs:
				crvs = []
				for seg in bound:
					crv = seg.GetCurve()
					crvs.append(Revit.GeometryConversion.RevitToProtoCurve.ToProtoType( crv, True ))
				boundcurves.append(crvs)
    	
			rooms.append(room)
			names.append(roomname)
			numbers.append(number)
			areas.append(area)
			levels.append(level)
			boundaries.append(boundcurves)
			locations.append(location)
			elementids.append(elementid)
			uniqueids.append(uniqueid)
        
	output.append(rooms)
	output.append(names)
	output.append(numbers)
	output.append(areas)
	output.append(levels)
	output.append(locations)
	output.append(boundaries)	
	output.append(elementids)
	output.append(uniqueids)
        
#Assign your output to the OUT variable
OUT = output
# ----------------------------------------
number = DoubleInput(0)  # graph input
getItemAtIndex = List.GetItemAtIndex(list=python_script, index=number)
VARElement = Output(getItemAtIndex)
number_2 = DoubleInput(1)  # graph input
getItemAtIndex_2 = List.GetItemAtIndex(list=python_script, index=number_2)
VARName = Output(getItemAtIndex_2)
number_3 = DoubleInput(2)  # graph input
getItemAtIndex_3 = List.GetItemAtIndex(list=python_script, index=number_3)
VARNumber = Output(getItemAtIndex_3)
number_4 = DoubleInput(3)  # graph input
getItemAtIndex_4 = List.GetItemAtIndex(list=python_script, index=number_4)
VARArea = Output(getItemAtIndex_4)
number_5 = DoubleInput(4)  # graph input
getItemAtIndex_5 = List.GetItemAtIndex(list=python_script, index=number_5)
VARLevelName = Output(getItemAtIndex_5)
number_6 = DoubleInput(5)  # graph input
getItemAtIndex_6 = List.GetItemAtIndex(list=python_script, index=number_6)
VARLocation = Output(getItemAtIndex_6)
number_7 = DoubleInput(6)  # graph input
getItemAtIndex_7 = List.GetItemAtIndex(list=python_script, index=number_7)
VARBoundaries = Output(getItemAtIndex_7)
number_8 = DoubleInput(7)  # graph input
getItemAtIndex_8 = List.GetItemAtIndex(list=python_script, index=number_8)
VARElementID = Output(getItemAtIndex_8)
number_9 = DoubleInput(8)  # graph input
getItemAtIndex_9 = List.GetItemAtIndex(list=python_script, index=number_9)
VARUniqueID = Output(getItemAtIndex_9)
