# Dynamo custom node LB.LunchBox Staggered Grid by Face .dyf "LB.LunchBox Staggered Grid by Face" (Dynamo 2.1.0.7500)
# category: Synthesize.Packages.LunchBox.Archive.Geometry.Panel
# Create a Staggered XYZ grid on a face.  The face surface must have an untrimmed UV parameter space.

VARSurface = Input(VARSurface: var[]..[])
flatten = List.Flatten(list=VARSurface)
byOriginNormal = Plane.ByOriginNormal()
VARU = Input(VARU: var[]..[])
VARV = Input(VARV: var[]..[])
byWidthLength = Rectangle.ByWidthLength(plane=byOriginNormal, width=VARU, length=VARV)
byPatch = Surface.ByPatch(closedCurve=byWidthLength)
turnIntoList = Custom[CW.TurnIntoList](VARunknownItem=byPatch)  # Turns an element (or a nested list) into a flat list
VARFalse4PointsPatternTrue9PointsPattern = Input(VARFalse4PointsPatternTrue9PointsPattern: bool = false)
VARRotate = Input(VARRotate: bool = false)
lb_lunchbox_list_matcher = Custom[LB.LunchBox List Matcher](VARListA=turnIntoList, VARListB=VARU)  # Compares a List A against a List B and matches length of List A. If ListA > ListB, ListB will be extended. If ListA < ListB, ListB will be truncated.
lb_lunchbox_list_matcher_2 = Custom[LB.LunchBox List Matcher](VARListA=turnIntoList, VARListB=VARV)
code_block = CodeBlock { false; }
python_script = Python(IN[0]=lb_lunchbox_list_matcher.VARListA, IN[1]=lb_lunchbox_list_matcher.VARMatchListB, IN[2]=lb_lunchbox_list_matcher_2.VARMatchListB, IN[3]=code_block)
# ---------- python_script.python (166 lines) ----------
#Copyright(c) 2014, Nathan Miller
# The Proving Ground, http://theprovingground.org

import clr
clr.AddReference('ProtoGeometry')
from Autodesk.DesignScript.Geometry import *


withsurfs = IN[3]

# Panel division class
class PanelDivision:
	
	# divide surface
	def StaggeredQuadDivision(self, srf, udiv, vdiv):
		ustep = 1.0/udiv
		vstep = 1.0/vdiv
		
		quads = []
		polys = []
		panels = []
		for i in range(0,int(udiv)):
			for j in range(0,int(vdiv)):
				# Condition 1
				if j%2 == 0:
					ptA = srf.PointAtParameter(i*ustep,j*vstep)
					ptB = srf.PointAtParameter((i+1)*ustep,j*vstep)
					ptC = srf.PointAtParameter((i+1)*ustep,(j+1)*vstep)
					ptD = srf.PointAtParameter(i*ustep,(j+1)*vstep)
					
					quad = []
					#Append to quad
					quad.append(ptA)
					quad.append(ptB)
					quad.append(ptC)
					quad.append(ptD)
					#Append quads
					quads.append(quad)
					
					#polygons
					#poly = Polygon.ByPoints(quad)
					#polys.append(poly)
				
					#panels
					#if withsurfs == True:
					#	panel = Surface.ByPerimeterPoints(quad)
					#	panels.append(panel)
					#else:
					#	panels.append(None)
					
				# Condition 2
				if j%2 == 1:
					if i < (udiv-1):
						ptA = srf.PointAtParameter((i+0.5)*ustep,j*vstep)
						ptB = srf.PointAtParameter((i+1.5)*ustep,j*vstep)
						ptC = srf.PointAtParameter((i+1.5)*ustep,(j+1)*vstep)
						ptD = srf.PointAtParameter((i+0.5)*ustep,(j+1)*vstep)
						
						quad = []
						#Append to quad
						quad.append(ptA)
						quad.append(ptB)
						quad.append(ptC)
						quad.append(ptD)
						#Append quads
						quads.append(quad)
						
						#polygons
						#poly = Polygon.ByPoints(quad)
						#polys.append(poly)
					
						#panels
						#if withsurfs == True:
						#	panel = Surface.ByPerimeterPoints(quad)
						#	panels.append(panel)
						#else:
						#	panels.append(None)

					# Condition 3
					if i == 0:
						ptA = srf.PointAtParameter(i*ustep,j*vstep)
						ptB = srf.PointAtParameter((i+0.5)*ustep,j*vstep)
						ptC = srf.PointAtParameter((i+0.5)*ustep,(j+1)*vstep)
						ptD = srf.PointAtParameter(i*ustep,(j+1)*vstep)
					
						quad = []
						#Append to quad
						quad.append(ptA)
						quad.append(ptB)
						quad.append(ptC)
						quad.append(ptD)
						#Append quads
						quads.append(quad)
						
						#polygons
						#poly = Polygon.ByPoints(quad)
						#polys.append(poly)
				
						#panels
						#if withsurfs == True:
						#	panel = Surface.ByPerimeterPoints(quad)
						#	panels.append(panel)
						#else:
						#	panels.append(None)
					
					# Condition 4
					if i == udiv-1:
						ptA = srf.PointAtParameter((i+0.5)*ustep,j*vstep)
						ptB = srf.PointAtParameter((i+1)*ustep,j*vstep)
						ptC = srf.PointAtParameter((i+1)*ustep,(j+1)*vstep)
						ptD = srf.PointAtParameter((i+0.5)*ustep,(j+1)*vstep)
					
						quad = []
						#Append to quad
						quad.append(ptA)
						quad.append(ptB)
						quad.append(ptC)
						quad.append(ptD)
						#Append quads
						quads.append(quad)
						
						#polygons
						#poly = Polygon.ByPoints(quad)
						#polys.append(poly)
				
						#panels
						#if withsurfs == True:
						#	panel = Surface.ByPerimeterPoints(quad)
						#	panels.append(panel)
						#else:
						#	panels.append(None)
						
		self.quads = quads
		#self.polys = polys
		#self.panels = panels

#Main code
srf = IN[0]
udiv = IN[1]
vdiv = IN[2]

quads = []
#polys = []
#panels = []

for k in range(0, len(srf)):
	s = srf[k]
	u = udiv[k]
	v = vdiv[k]
			
	divide = PanelDivision()
	divide.StaggeredQuadDivision(s,u,v)
					
	quads.append(divide.quads)
	#panels.append(divide.panels)
	#polys.append(divide.polys)
	

output = []
output = quads
#output.append(quads)
#output.append(polys)
#output.append(panels)

#Assign your output to the OUT variable
OUT = output
# ----------------------------------------
empty = List.Empty()
scopeIf = Custom[CW.ScopeIf+](VARtest=VARRotate, VARtrue=python_script, VARfalse=empty)  # A (hopefully) more robust implementation of ScopeIf. Tests a single boolean and returns a value accordingly.
UVParameterAtPoint = Surface.UVParameterAtPoint(surface=turnIntoList, point=scopeIf)
V = UV.V(uV=UVParameterAtPoint)
reverse = List.Reverse(list=V@@L2)
U = UV.U(uV=UVParameterAtPoint)
reverse_2 = List.Reverse(list=U@@L2)
pointAtParameter = Surface.PointAtParameter(surface=turnIntoList, u=reverse, v=reverse_2)
scopeIf_2 = Custom[CW.ScopeIf+](VARtest=VARRotate, VARtrue=pointAtParameter, VARfalse=python_script)
empty_2 = List.Empty()
scopeIf_3 = Custom[CW.ScopeIf+](VARtest=VARFalse4PointsPatternTrue9PointsPattern, VARtrue=scopeIf_2, VARfalse=empty_2)
byPoints = Polygon.ByPoints(points=scopeIf_3)
explode = Geometry.Explode(geometry=byPoints)
code_block_2 = CodeBlock { 0.5; }
splitByParameter = Curve.SplitByParameter(curve=explode, parameters=code_block_2)
flatten_2 = List.Flatten(list=splitByParameter@@L3)
startPoint = Curve.StartPoint(curve=flatten_2)
code_block_3 = CodeBlock { 3; }
getItemAtIndex = List.GetItemAtIndex(list=startPoint@@L2, index=code_block_3)
code_block_4 = CodeBlock { 7; }
getItemAtIndex_2 = List.GetItemAtIndex(list=startPoint@@L2, index=code_block_4)
python_script_2 = Python(IN[0]=startPoint, IN[1]=getItemAtIndex, IN[2]=getItemAtIndex_2, IN[3]=turnIntoList)
# ---------- python_script_2.python (82 lines) ----------
# Enable Python support and load DesignScript library
# IMPORTANT : ALL DYNAMO DESIGN SCRIPT NODES ARE AS (dg)
import clr
clr.AddReference('ProtoGeometry')
from Autodesk.DesignScript import Geometry as dg

# EXTENSION Enable ToDSType
clr.AddReference('RevitNodes')
import Revit
clr.ImportExtensions(Revit.Elements)

# Enable Revit Elements
from Revit.Elements import *

# EXTENSION Enable Geometry Conversion Methods
clr.ImportExtensions(Revit.GeometryConversion)

# Enable Revit API
clr.AddReference('RevitAPI')
from Autodesk.Revit.DB import *

# Enable DocumentManager and TransactionManager
clr.AddReference('RevitServices')
from RevitServices.Persistence import DocumentManager
from RevitServices.Transactions import TransactionManager

# Enable ICollection List Translate
clr.AddReference("System")
import System.Collections.Generic
from System.Collections.Generic import List

dataEnteringNode = IN
# Use UnwrapElement(IN[0]) When Translating From Dynamo to Revit

# Choose The Current Document
doc = DocumentManager.Instance.CurrentDBDocument
uidoc = DocumentManager.Instance.CurrentUIApplication.ActiveUIDocument
uiapp = DocumentManager.Instance.CurrentUIApplication
app = uiapp.Application


big = IN[0]
p1 = UnwrapElement(IN[1])
p2 = UnwrapElement(IN[2])
surfs = UnwrapElement(IN[3])
toins = []
countout = 0
for e in range(len(p1)):
	count = 0
	tmp = []
	for e in p1[countout]:
		line = dg.Line.ByStartPointEndPoint(e,p2[countout][count])
		midp = dg.Curve.PointAtParameter(line,0.5)
		tmp.append(midp)
		line.Dispose()
		count = count + 1
	toins.append(tmp)
	countout = countout + 1

count = 0
for each in big:
	ind = big.IndexOf(each)
	countin = 0
	for e in each:
		e.insert(4,toins[ind][countin])
		a1 = e.pop(3)
		a2 = e.pop(5)
		a3 = e.pop(6)
		a4 = e.pop(4)
		a5 = e.pop(3)
		a6 = e.pop(3)
		e.insert(3,a3)
		e.insert(4,a5)
		e.insert(5,a1)
		e.insert(6,a6)
		e.insert(7,a2)
		e.insert(8,a4)
		countin = countin + 1
	count = count + 1
#Assign your output to the OUT variable.

OUT = big
# ----------------------------------------
scopeIf_4 = Custom[CW.ScopeIf+](VARtest=VARFalse4PointsPatternTrue9PointsPattern, VARtrue=python_script_2, VARfalse=scopeIf_2)
UVParameterAtPoint_2 = Surface.UVParameterAtPoint(surface=turnIntoList, point=scopeIf_4)
U_2 = UV.U(uV=UVParameterAtPoint_2)
V_2 = UV.V(uV=UVParameterAtPoint_2)
pointAtParameter_2 = Surface.PointAtParameter(surface=flatten, u=U_2, v=V_2, lacing=Longest)
VARPanelPts = Output(pointAtParameter_2)
VARShowPolygons = Input(VARShowPolygons: bool = false)
empty_3 = List.Empty()
scopeIf_5 = Custom[CW.ScopeIf+](VARtest=VARShowPolygons, VARtrue=pointAtParameter_2, VARfalse=empty_3)
code_block_5 = CodeBlock { 0; 2; 6; 8; }
join = List.Join(list0=code_block_5.out0, list1=code_block_5.out1, list2=code_block_5.out2, list3=code_block_5.out3)
getItemAtIndex_3 = List.GetItemAtIndex(list=scopeIf_5@@L2, index=join)
scopeIf_6 = Custom[CW.ScopeIf+](VARtest=VARFalse4PointsPatternTrue9PointsPattern, VARtrue=getItemAtIndex_3, VARfalse=scopeIf_5)
python_script_3 = Python(IN[0]=scopeIf_6, IN[1]=VARFalse4PointsPatternTrue9PointsPattern)
# ---------- python_script_3.python (57 lines) ----------
# Enable Python support and load DesignScript library
# IMPORTANT : ALL DYNAMO DESIGN SCRIPT NODES ARE AS (dg)
import clr
clr.AddReference('ProtoGeometry')
from Autodesk.DesignScript import Geometry as dg

# EXTENSION Enable ToDSType
clr.AddReference('RevitNodes')
import Revit
clr.ImportExtensions(Revit.Elements)

# Enable Revit Elements
from Revit.Elements import *

# EXTENSION Enable Geometry Conversion Methods
clr.ImportExtensions(Revit.GeometryConversion)

# Enable Revit API
clr.AddReference('RevitAPI')
from Autodesk.Revit.DB import *

# Enable DocumentManager and TransactionManager
clr.AddReference('RevitServices')
from RevitServices.Persistence import DocumentManager
from RevitServices.Transactions import TransactionManager

# Enable ICollection List Translate
clr.AddReference("System")
import System.Collections.Generic
from System.Collections.Generic import List

dataEnteringNode = IN
# Use UnwrapElement(IN[0]) When Translating From Dynamo to Revit

# Choose The Current Document
doc = DocumentManager.Instance.CurrentDBDocument
uidoc = DocumentManager.Instance.CurrentUIApplication.ActiveUIDocument
uiapp = DocumentManager.Instance.CurrentUIApplication
app = uiapp.Application


big = IN[0]
cond = IN[1]

if cond == True:
	count = 0
	for each in big:
		ind = big.IndexOf(each)
		countin = 0
		for e in each:
			a1 = e.pop(2)
			e.insert(3,a1)
			countin = countin + 1
		count = count + 1
		
#Assign your output to the OUT variable.
OUT = big
# ----------------------------------------
byPoints_2 = Polygon.ByPoints(points=python_script_3)
python_null_2_empty = Custom[Python Null 2 Empty](VARIN=byPoints_2)  # Python Null 2 Empty
VARPolygons = Output(python_null_2_empty)
