# Dynamo custom node LB.LunchBox Triangle Grid by Face.dyf (Dynamo 2.1.0.7500)
# category: Synthesize.Packages.LunchBox.Archive.Geometry.Panel
# Create a Triangular XYZ grid on a face.  The face surface must have an untrimmed UV parameter space.

VARSurface = Input(VARSurface: var[]..[])
VARU = Input(VARU: var[]..[])
lb_lunchbox_list_matcher = Custom[LB.LunchBox List Matcher](VARListA=VARSurface, VARListB=VARU)  # Compares a List A against a List B and matches length of List A. If ListA > ListB, ListB will be extended. If ListA < ListB, ListB will be truncated.
VARV = Input(VARV: var[]..[])
lb_lunchbox_list_matcher_2 = Custom[LB.LunchBox List Matcher](VARListA=VARSurface, VARListB=VARV)
python_script = Python(IN[0]=lb_lunchbox_list_matcher.VARListA, IN[1]=lb_lunchbox_list_matcher.VARMatchListB, IN[2]=lb_lunchbox_list_matcher_2.VARMatchListB)
# ---------- python_script.python (92 lines) ----------
#Copyright(c) 2014, Nathan Miller
# The Proving Ground, http://theprovingground.org

import clr
clr.AddReference('ProtoGeometry')
from Autodesk.DesignScript.Geometry import *

# Panel division class
class PanelDivision:
	
	# divide surface
	def TriDivision(self, srf, udiv, vdiv):
		ustep = 1.0/udiv
		vstep = 1.0/vdiv
		
		tris = []
		polys = []
		panels = []
		for i in range(0,int(udiv)):
			for j in range(0,int(vdiv)):
			
				triA = []
				triB = []
				
				#XYZ Tris A
				myXYZ1A = srf.PointAtParameter(i*ustep, j*vstep)
				myXYZ1B = srf.PointAtParameter((i+1)*ustep,j*vstep)
				myXYZ1C = srf.PointAtParameter((i+1)*ustep,(j+1)*vstep)
				
				#XYZ Tris B
				myXYZ2A = srf.PointAtParameter((i+1)*ustep,(j+1)*vstep)
				myXYZ2B = srf.PointAtParameter(i*ustep,(j+1)*vstep)
				myXYZ2C = srf.PointAtParameter(i*ustep, j*vstep)
				
				#Append to tri
				triA.append(myXYZ1A)
				triA.append(myXYZ1B)
				triA.append(myXYZ1C)
		
				triB.append(myXYZ2A)
				triB.append(myXYZ2B)
				triB.append(myXYZ2C)
				
				#Append tris
				tris.append(triA)
				tris.append(triB)
				
				#Polygons
				#polyA = Polygon.ByPoints(triA)
				#polyB = Polygon.ByPoints(triB)
				#polys.append(polyA)
				#polys.append(polyB)
				
				#Panels
				#panelA = Surface.ByPerimeterPoints(triA)
				#panelB = Surface.ByPerimeterPoints(triB)
				#panels.append(panelA)
				#panels.append(panelB)
				
		self.tris = tris
		#self.polys = polys
		#self.panels = panels

#Main code
srf = IN[0]
udiv = IN[1]
vdiv = IN[2]

tris = []
#polys = []
#panels = []

for k in range(0, len(srf)):
	s = srf[k]
	u = udiv[k]
	v = vdiv[k]
			
	divide = PanelDivision()
	divide.TriDivision(s,u,v)
					
	tris.append(divide.tris)
	#panels.append(divide.panels)
	#polys.append(divide.polys)
	

output = []
output.append(tris)
#output.append(polys)
#output.append(panels)

#Assign your output to the OUT variable
OUT = output
# ----------------------------------------
number = DoubleInput(0)  # graph input
getItemAtIndex = List.GetItemAtIndex(list=python_script, index=number)
VARPanelPts = Output(getItemAtIndex)
number_2 = DoubleInput(1)  # graph input
getItemAtIndex_2 = List.GetItemAtIndex(list=python_script, index=number_2)
VARPanelPolys = Output(getItemAtIndex_2)
VARShowPolygons = Input(VARShowPolygons: bool = false)
empty = List.Empty()
scopeIf = Custom[CW.ScopeIf+](VARtest=VARShowPolygons, VARtrue=getItemAtIndex, VARfalse=empty)  # A (hopefully) more robust implementation of ScopeIf. Tests a single boolean and returns a value accordingly.
byPoints = Polygon.ByPoints(points=scopeIf)
VARPolygons = Output(byPoints)
