# Dynamo custom node LB.LunchBox Wave.dyf (Dynamo 2.1.0.7500)
# category: Synthesize.Packages.LunchBox.Geometry.Form
# Creates a parametric Wave surface

VARU = Input(VARU: var[]..[])
VARV = Input(VARV: var[]..[])
VARA = Input(VARA: var[]..[])
VARB = Input(VARB: var[]..[])
VARS = Input(VARS: var[]..[])
VARU0 = Input(VARU0: var[]..[])
VARU1 = Input(VARU1: var[]..[])
VARV0 = Input(VARV0: var[]..[])
VARV1 = Input(VARV1: var[]..[])
python_script = Python(IN[0]=VARU, IN[1]=VARV, IN[2]=VARA, IN[3]=VARB, IN[4]=VARS, IN[5]=VARU0, IN[6]=VARU1, IN[7]=VARV0, IN[8]=VARV1)
# ---------- python_script.python (57 lines) ----------
#Copyright(c) 2014, Nathan Miller
# The Proving Ground, http://theprovingground.org
import clr
import math
from System import Array
clr.AddReference('ProtoGeometry')
from Autodesk.DesignScript.Geometry import *

#Variables
U = IN[0]
V = IN[1]
A = IN[2]
B = IN[3]
S = IN[4]
U0 = IN[5]
U1 = IN[6]
V0 = IN[7]
V1 = IN[8]

uStep = math.fabs(U1 - U0) / (U-1)
vStep = math.fabs(V1 - V0) / (V-1)
uCount = 0
vCount = 0

i = U0
j = V0

newU = 0
while i <= U1 + uStep:
	i = i + uStep
	newU = newU + 1

i=U0

ptsarrarr = Array.CreateInstance(Array[Point], newU)
while i <= U1 + uStep and uCount <= newU:
	j = V0
	vCount = 0
	ptsarr = Array.CreateInstance(Point, V)
	while j <= V1 + vStep:
		x = i
		y = j
		z = (A * math.sin(B*i)) + (A * math.cos(B*j))
		
		pt = Point.ByCoordinates(x*S,y*S,z*S)
		ptsarr[vCount] = pt
		
		j = j + vStep
		vCount = vCount + 1
		
	ptsarrarr[uCount] = ptsarr
	i = i + uStep
	uCount = uCount + 1

srf = NurbsSurface.ByPoints(ptsarrarr)
	
OUT = srf
# ----------------------------------------
VARSurface = Output(python_script)
