# Dynamo custom node LF.FamilyInstance.RandomRotation.dyf (Dynamo 2.1.0.7500)
# category: Synthesize.Packages.Landform.Revit.Elements.FamilyInstance
# Rotates the angle of the family instance a random amount (between 0 and 360).

VARfamilyInstance = Input(VARfamilyInstance: var[]..[])
code_block = CodeBlock { 0; }
code_block_2 = CodeBlock { 360; }
count = List.Count(list=VARfamilyInstance)
randomIntegerMin = Custom[LF.Math.RandomIntegerMin](VARmin=code_block, VARmax=code_block_2, VARamount=count)  # Creates a list of random integers between a given minimum and maximum value
setRotation = FamilyInstance.SetRotation(familyInstance=VARfamilyInstance, degree=randomIntegerMin)
VARFamilyInstance = Output(setRotation)
