# Dynamo custom node LF.List.MatchLength.dyf (Dynamo 2.1.0.7500)
# category: Synthesize.Packages.Landform.Core.List
# Cycle a list to match the length of the first list.

VARlist = Input(VARlist: var[]..[])
count = List.Count(list=VARlist)
code_block = CodeBlock { 1; }
gt = count > code_block
cycle = List.Cycle()  # unwired: list, amount
VARlistLength = Input(VARlistLength: var[]..[])
count_2 = List.Count()  # unwired: list
map = List.Map(list=VARlistLength, f_x=count_2)
combine = List.Combine(comb=cycle, list1=VARlist, list2=map)
count_3 = List.Count(list=VARlistLength)
cycle_2 = List.Cycle(list=VARlist, amount=count_3)
code_block_2 = CodeBlock(test=gt, iftrue=combine, iffalse=cycle_2) { oldif(test,iftrue,iffalse); }
VARlist_2 = Output(code_block_2)  # "VARlist"
code_block_3 = CodeBlock()
# ---------- code_block_3.designscript (15 lines) ----------
def oldif(test,iftrue:var[]..[],
iffalse:var[]..[])
{
return = [Imperative]
{
if (test)
{
return = iftrue;
}
else
{
return = iffalse;
}
}
};
# ----------------------------------------
