# Dynamo custom node LF.Point.Random.dyf (Dynamo 2.1.0.7500)
# category: Synthesize.Packages.Landform.Geometry.Point
# Creates a random set of points within a set of boundary cuves. Tolerance specifies the minimum distance between points.

VARcurves = Input(VARcurves: var[]..[])
flatten = List.Flatten(list=VARcurves)
byJoinedCurves = PolyCurve.ByJoinedCurves(curves=flatten)
patch = Curve.Patch(curve=byJoinedCurves)
VARamount = Input(VARamount: int)
randomList = Math.RandomList(amount=VARamount)
randomList_2 = Math.RandomList(amount=VARamount)
pointAtParameter = Surface.PointAtParameter(surface=patch, u=randomList, v=randomList_2)
VARtolerance = Input(VARtolerance: double)
pruneDuplicates = Point.PruneDuplicates(points=pointAtParameter, tolerance=VARtolerance)
perimeterCurves = Surface.PerimeterCurves(surface=patch)
startPoint = Curve.StartPoint(curve=perimeterCurves)
byPoints = Polygon.ByPoints(points=startPoint)
containmentTest = Polygon.ContainmentTest(polygon=byPoints, point=pruneDuplicates)
filterByBoolMask = List.FilterByBoolMask(list=pruneDuplicates, mask=containmentTest)
VARPoints = Output(filterByBoolMask.in)
