# Dynamo custom node LF.Point.XYZ.dyf (Dynamo 2.1.0.7500)
# category: Synthesize.Packages.Landform.Geometry.Point
# Get the X, Y, and Z components of a Point

VARpoint = Input(VARpoint: var[]..[])
X = Point.X(point=VARpoint)
VARX = Output(X)
Y = Point.Y(point=VARpoint)
VARY = Output(Y)
Z = Point.Z(point=VARpoint)
VARZ = Output(Z)
