# Dynamo custom node LF.Point.ZRange.dyf (Dynamo 2.1.0.7500)
# category: Synthesize.Packages.Landform.Geometry.Point
# Get all Z components and the minimum and maximum Z components from a list of Points.

VARpoints = Input(VARpoints: var[]..[])
Z = Point.Z(point=VARpoints)
VARdouble = Output(Z)
minimumItem = List.MinimumItem(list=Z)
VARmin = Output(minimumItem)
maximumItem = List.MaximumItem(list=Z)
VARmax = Output(maximumItem)
