# Dynamo custom node LF.Points.SameXY.dyf (Dynamo 2.1.0.7500)
# category: Synthesize.Packages.Landform.Geometry.Point
# Find points that share the same XY (or overlap in plan). Used for creating Topography.

VARpoints = Input(VARpoints: var[]..[])
sortByXY = Custom[LF.Points.SortByXY](VARpoints=VARpoints)  # Sort list of points based on its X and Y coordinate values. In order to sort correctly, points must be rounded (default value is 3 decimal points).
Y = Point.Y(point=sortByXY.VARXthenY)
code_block = CodeBlock { -1; }
shiftIndices = List.ShiftIndices(list=Y, amount=code_block)
eq = Y == shiftIndices
countTrue = List.CountTrue(list=eq)
code_block_2 = CodeBlock { 1; }
shiftIndices_2 = List.ShiftIndices(list=Y, amount=code_block_2)
eq_2 = Y == shiftIndices_2
countTrue_2 = List.CountTrue(list=eq_2)
add = countTrue + countTrue_2
VARcount = Output(add)
filterByBoolMask = List.FilterByBoolMask(list=sortByXY.VARXthenY, mask=eq)
filterByBoolMask_2 = List.FilterByBoolMask(list=sortByXY.VARXthenY, mask=eq_2)
join = List.Join(list0=filterByBoolMask.in, list1=filterByBoolMask_2.in)
VARpoints_2 = Output(join)  # "VARpoints"
