# Dynamo custom node LF.Points.SortByDistance.dyf (Dynamo 2.1.0.7500)
# category: Synthesize.Packages.Landform.Core.List
# Sort a list of points based on their distance from a specified point

VARelements = Input(VARelements: var[]..[])
VARpoints = Input(VARpoints: var[]..[])
VARbasePoint = Input(VARbasePoint: var[]..[])
matchLength = Custom[LF.List.MatchLength](VARlistLength=VARpoints, VARlist=VARbasePoint)  # Cycle a list to match the length of the first list.
byStartPointEndPoint = Line.ByStartPointEndPoint(startPoint=matchLength, endPoint=VARpoints)
length = Curve.Length(curve=byStartPointEndPoint)
as_list_sortbykey = Custom[AS.[&] List.SortByKey](VARlist=VARelements, VARkeys=length)  # Sort a list (or lists) according to the order specified by the key list.
VARsortedlist = Output(as_list_sortbykey.VARsortedlist)
