# Dynamo custom node LF.Points.SortByXY.dyf (Dynamo 2.1.0.7500)
# category: Synthesize.Packages.Landform.Core.List
# Sort list of points based on its X and Y coordinate values. In order to sort correctly, points must be rounded (default value is 3 decimal points).

VARpoints = Input(VARpoints: var[]..[])
Y = Point.Y(point=VARpoints)
VARround = Input(VARround: int = 3)
round = Math.Round(number=Y, digits=VARround)
sortByKey = List.SortByKey(list=VARpoints, keys=round)
X = Point.X(point=sortByKey.sorted_list)
round_2 = Math.Round(number=X, digits=VARround)
sortByKey_2 = List.SortByKey(list=sortByKey.sorted_list, keys=round_2)
VARXthenY = Output(sortByKey_2.sorted_list)
X_2 = Point.X(point=VARpoints)
round_3 = Math.Round(number=X_2, digits=VARround)
sortByKey_3 = List.SortByKey(list=VARpoints, keys=round_3)
Y_2 = Point.Y(point=sortByKey_3.sorted_list)
round_4 = Math.Round(number=Y_2, digits=VARround)
sortByKey_4 = List.SortByKey(list=sortByKey_3.sorted_list, keys=round_4)
VARYthenX = Output(sortByKey_4.sorted_list)
