# Dynamo custom node LF.SlabShape.Points.dyf (Dynamo 2.1.0.7500)
# category: Synthesize.Packages.Landform.Revit.Elements.Floor
# Get the XYZ points of any slab shape Roof or Floor.

VARFloorOrRoof = Input(VARFloorOrRoof: var[]..[])
python_script = Python(IN[0]=VARFloorOrRoof)
# ---------- python_script.python (14 lines) ----------
import clr

clr.AddReference("RevitNodes")
import Revit
clr.ImportExtensions(Revit.GeometryConversion)

slabshape = UnwrapElement(IN[0])
points = []

vert = slabshape.SlabShapeEditor.SlabShapeVertices
for v in vert:
	points.append(v.Position.ToPoint(True))

OUT = points
# ----------------------------------------
VARPoints = Output(python_script)
