# Dynamo custom node Lines Auto Dimensions.dyf (Dynamo 2.1.0.7500)
# category: Synthesize.Automate.Dimensions
# Lines Auto Dimensions

VARCurves = Input(VARCurves: var[]..[])
VARViews = Input(VARViews: var[]..[])
python_script = Python(IN[0]=VARCurves, IN[1]=VARViews)
# ---------- python_script.python (78 lines) ----------
#Import required lybraries
import clr
clr.AddReference('RevitAPI')
from Autodesk.Revit.DB import *
clr.AddReference('RevitServices')
import RevitServices
from RevitServices.Persistence import DocumentManager
from RevitServices.Transactions import TransactionManager
doc = DocumentManager.Instance.CurrentDBDocument
clr.AddReference('RevitNodes')
import Revit
clr.ImportExtensions(Revit.Elements)
clr.ImportExtensions(Revit.GeometryConversion)
from Revit.Elements import *
clr.AddReference('ProtoGeometry')
from Autodesk.DesignScript.Geometry import *

#Data Entry
inNode0 = IN [0]
views = UnwrapElement(IN[1])
lineList = []
lineListRevitType=[]

#If more tham one element add it to a list
if isinstance(inNode0, list):
	lineList.extend(IN[0])
#if one element make it a 1 elemnt list tor the iterention works	
else:
	lineList.append(IN[0])
	lineList = UnwrapElement(lineList)
	lineListRevitType = []
#Iterate over Lines (list items), make it revit types to be used by the API 
for l in lineList:
	lineListRevitType.append(l.ToRevitType(True)) #line se llamaba
#Start the document transaction
TransactionManager.Instance.EnsureInTransaction(doc)

#Initialize the variables needed
detailCurveList = []
line_List = []
referencesList = []
dimensions = []
u=[]
#Iterate over the lineList(revit elements) to create the dimentions from it's reference points (Start and End points):
for i in range(len(lineList)): #detail_curve
	try:
		detailCurveList.append(doc.Create.NewDetailCurve(views, lineListRevitType[i]))
	except:
		detailCurveList.append(None)
		
	try:
		line_List.append(UnwrapElement(detailCurveList[i]).GeometryCurve)
	except:
		line_List.append(None)
		
	referencesList.append(ReferenceArray())
	
	try:
		referencesList[i].Append(UnwrapElement(line_List[i]).GetEndPointReference(0))
	except:
		referencesList[i].Append(None)
		
	try:
		referencesList[i].Append(UnwrapElement(line_List[i]).GetEndPointReference(1))
	except:
		referencesList[i].Append(None)
		
	try:	
		dimensions.append(doc.Create.NewDimension(views, lineListRevitType[i], referencesList[i]))
	except:
		dimensions.append(None)
		
	u.append(i)
#Close Document transaction

TransactionManager.Instance.TransactionTaskDone() 

OUT = dimensions
# ----------------------------------------
VARDimension = Output(python_script)
