# Dynamo custom node Lines Segmentation By Distance.dyf (Dynamo 2.1.0.7500)
# category: Synthesize.Automate.Lines
# Lines Segmentation By Distance

VARSegmentationDistance = Input(VARSegmentationDistance: var[]..[])
code_block = CodeBlock { 0; }
eq = VARSegmentationDistance == code_block
VARCurves = Input(VARCurves: var[]..[])
flatten = List.Flatten(list=VARCurves)
explode = Geometry.Explode(geometry=flatten)
as_polycurve_bycurves = Custom[AS.[&] PolyCurve.ByCurves](VARcurves=explode)  # Create polycurves from an unordered list of curves.
flatten_2 = List.Flatten(list=as_polycurve_bycurves.VARpolyCurve)
code_block_2 = CodeBlock { false; }
clean = List.Clean(list=flatten, preserveIndices=code_block_2)
join = List.Join()  # unwired: list0, list1
code_block_3 = CodeBlock { 0; 1; }
length = Curve.Length(curve=clean)
div = length / VARSegmentationDistance
ceiling = Math.Ceiling(number=div)
sequence = Sequence(start=code_block_3.out0, amount=ceiling, step=code_block_3.out1, lacing=Longest)
remapRange = Math.RemapRange(numbers=sequence, newMin=code_block_3.out0, newMax=code_block_3.out1)
code_block_4 = CodeBlock { 0; 1; }
join_2 = List.Join(list0=code_block_4.out0, list1=code_block_4.out1)
create = List.Create(item0=join_2)
matchLength = Custom[LF.List.MatchLength](VARlistLength=remapRange, VARlist=create)  # Cycle a list to match the length of the first list.
combine = List.Combine(comb=join, list1=remapRange, list2=matchLength)
code_block_5 = CodeBlock { 1; }
dropItems = List.DropItems(list=combine@L2, amount=code_block_5)
uniqueItems = List.UniqueItems(list=dropItems@L2)
sort = List.Sort(list=uniqueItems@L2)
pointAtParameter = Curve.PointAtParameter(curve=clean, param=sort)
VARConnectLastToFirst = Input(VARConnectLastToFirst: bool = false)
byPoints = PolyCurve.ByPoints(points=pointAtParameter@L2, connectLastToFirst=VARConnectLastToFirst)
code_block_6 = CodeBlock { false; }
clean_2 = List.Clean(list=byPoints, preserveIndices=code_block_6)
scopeIf = Custom[CW.ScopeIf+](VARtest=eq, VARtrue=flatten_2, VARfalse=clean_2)  # A (hopefully) more robust implementation of ScopeIf. Tests a single boolean and returns a value accordingly.
VARPolycurve = Output(scopeIf)
