# Dynamo custom node List Files In Path.dyf (Dynamo 2.1.0.7500)
# category: Synthesize.Automate.List
# List Files In Patch

VARPath = Input(VARPath: var[]..[])
python_script = Python(IN[0]=VARPath)
# ---------- python_script.python (16 lines) ----------
import clr
import System

pf_path = System.Environment.GetFolderPath(System.Environment.SpecialFolder.ProgramFilesX86)
import sys
sys.path.append('%s\IronPython 2.7\Lib' %pf_path)

import os

satpath = IN[0]

def fast_files(dir):
    allfiles = [os.path.join(path, name) for path, subdirs, files in os.walk(dir) for name in files]
    return allfiles

OUT = fast_files(satpath)
# ----------------------------------------
VARFiles = Output(python_script)
