# Dynamo custom node List.FirstItem Fixer.dyf (Dynamo 2.1.0.7500)
# category: Synthesize.Fixers
# List.FirstItem Fixer

VARlist = Input(VARlist: var[]..[])
firstItem = List.FirstItem(list=VARlist)
VARfirst = Output(firstItem)
