# Dynamo custom node List.GetItemAtIndex Fixer.dyf (Dynamo 2.1.0.7500)
# category: Synthesize.Fixers
# List.GetItemAtIndex Fixer

VARlist = Input(VARlist: var[]..[])
VARindex = Input(VARindex: var[]..[])
getItemAtIndex = List.GetItemAtIndex(list=VARlist, index=VARindex)
VARitem = Output(getItemAtIndex)
