# Dynamo custom node List.LastItem Fixer.dyf (Dynamo 2.1.0.7500)
# category: Synthesize.Fixers
# List.LastItem Fixer

VARlist = Input(VARlist: var[]..[])
lastItem = List.LastItem(list=VARlist)
VARlast = Output(lastItem)
