# Dynamo custom node List.MaximumItem Fixer.dyf (Dynamo 2.1.0.7500)
# category: Synthesize.Fixers
# List.MaximumItem Fixer

list = Input(list: var[])
maximumItem = List.MaximumItem(list=list)
max = Output(maximumItem)
