# Dynamo custom node Load Family Documents.dyf (Dynamo 2.1.0.7500)
# category: Synthesize.Automate.Document
# Load Family Documents

VARFamDocs = Input(VARFamDocs: var[]..[])
python_script = Python(IN[0]=VARFamDocs)
# ---------- python_script.python (39 lines) ----------
# Common Language Runtime module
import clr
clr.AddReference('RevitAPI')
clr.AddReference('RevitServices')

# Revit and Dynamo module
from Autodesk.Revit.DB import Document, FamilySource, IFamilyLoadOptions
from RevitServices.Persistence import DocumentManager
from RevitServices.Transactions import TransactionManager

doc = DocumentManager.Instance.CurrentDBDocument
uiapp = DocumentManager.Instance.CurrentUIApplication
app = uiapp.Application

# argument assigned the IN port
fam_docs = IN[0]  # document list

# wrap input inside a list (if not a list)
if not isinstance(fam_docs, list):
    fam_docs = [fam_docs]

# ensure loaded families can overwrite existing families.
class FamilyOption(IFamilyLoadOptions):
    def OnFamilyFound(self, familyInUse, overwriteParameterValues):
        overwriteParameterValues = True
        return True

    def OnSharedFamilyFound(
            self, sharedFamily, familyInUse, source, overwriteParameterValues):
        source = FamilySource.Family
        overwriteParameterValues = True
        return True

# core data processing
for fam_doc in fam_docs:
    fam_doc.LoadFamily(doc, FamilyOption())

# return assigned the OUT port
OUT = fam_docs
# ----------------------------------------
VARout = Output(python_script)
