# Dynamo custom node MOD.DisallowAllow Join in STR Framing.dyf (Dynamo 2.1.0.7500)
# category: Synthesize.Packages.Modelical.Structure
# Disallow or allow join condition at Structural Framing ends (True = Disallow | False = Allow)

VARstrFraming = Input(VARstrFraming: var[]..[])
VARTrueFalse = Input(VARTrueFalse: bool)
python_script = Python(IN[0]=VARstrFraming, IN[1]=VARTrueFalse)
# ---------- python_script.python (63 lines) ----------
# This node has been made by Modelical
# www.modelical.com

import clr
clr.AddReference('ProtoGeometry')
from Autodesk.DesignScript.Geometry import *

#Load Dynamo wrappers
clr.AddReference("RevitNodes")
import Revit
from Revit.Elements import *
clr.ImportExtensions(Revit.GeometryConversion)
clr.ImportExtensions(Revit.Elements)

#Load Revit API
clr.AddReference('RevitAPI')
from Autodesk.Revit.DB import *
from Autodesk.Revit.DB.Structure import *
import Autodesk

#Load document reference
clr.AddReference("RevitServices")
import RevitServices
from RevitServices.Persistence import DocumentManager
from RevitServices.Transactions import TransactionManager

doc = DocumentManager.Instance.CurrentDBDocument
uiapp = DocumentManager.Instance.CurrentUIApplication
app = uiapp.Application

def toList(input):
	if isinstance(input,list) == False:
		return [input]
	else:
		return input

def flatten(x):
    result = []
    for el in x:
        if hasattr(el, "__iter__") and not isinstance(el, basestring):
            result.extend(flatten(el))
        else:
            result.append(el)
    return result

strFraming = flatten(toList(UnwrapElement(IN[0])))
disallowed = IN[1]

if disallowed:
	TransactionManager.Instance.EnsureInTransaction(doc)
	for strF in strFraming:
		StructuralFramingUtils.DisallowJoinAtEnd(strF,0)
		StructuralFramingUtils.DisallowJoinAtEnd(strF,1)
	TransactionManager.Instance.TransactionTaskDone()

else:
	TransactionManager.Instance.EnsureInTransaction(doc)
	for strF in strFraming:
		StructuralFramingUtils.AllowJoinAtEnd(strF,0)
		StructuralFramingUtils.AllowJoinAtEnd(strF,1)
	TransactionManager.Instance.TransactionTaskDone()

OUT = strFraming
# ----------------------------------------
VARstrFraming_2 = Output(python_script)  # "VARstrFraming"
code_block = CodeBlock { "Disallowed"; "Allowed"; }
scopeIf = Custom[CW.ScopeIf+](VARtest=VARTrueFalse, VARtrue=code_block.out0, VARfalse=code_block.out1)  # A (hopefully) more robust implementation of ScopeIf. Tests a single boolean and returns a value accordingly.
VARState = Output(scopeIf)
