# Dynamo custom node Map Revit Custom Panels.dyf (Dynamo 2.1.0.7500)
# category: Synthesize.Automate.Adaptive
# Map Revit Panels

VARTargetSurfaces = Input(VARTargetSurfaces: var[]..[])
flatten = List.Flatten(list=VARTargetSurfaces)
VARSourceSurfaces = Input(VARSourceSurfaces: var[]..[])
firstItem = List.FirstItem(list=VARSourceSurfaces)
get_pure_surfaces_of_flat = Custom[Get Pure Surfaces of Flat Detected Adaptive Components](VARSurfaces=firstItem)  # Get Pure Surfaces of Flat Detected Adaptive Components
flatten_2 = List.Flatten(list=get_pure_surfaces_of_flat)
python_script = Python(IN[0]=flatten_2)
# ---------- python_script.python (58 lines) ----------
# Enable Python support and load DesignScript library
# IMPORTANT : ALL DYNAMO DESIGN SCRIPT NODES ARE AS (dg)
import clr
clr.AddReference('ProtoGeometry')
from Autodesk.DesignScript import Geometry as dg

# EXTENSION Enable ToDSType
clr.AddReference('RevitNodes')
import Revit
clr.ImportExtensions(Revit.Elements)

# Enable Revit Elements
from Revit.Elements import *

# EXTENSION Enable Geometry Conversion Methods
clr.ImportExtensions(Revit.GeometryConversion)

# Enable Revit API
clr.AddReference('RevitAPI')
from Autodesk.Revit.DB import *

# Enable DocumentManager and TransactionManager
clr.AddReference('RevitServices')
from RevitServices.Persistence import DocumentManager
from RevitServices.Transactions import TransactionManager

# Enable ICollection List Translate
clr.AddReference("System")
import System.Collections.Generic
from System.Collections.Generic import List

dataEnteringNode = IN
# Use UnwrapElement(IN[0]) When Translating From Dynamo to Revit
surfs=UnwrapElement(IN[0])

# Choose The Current Document
doc = DocumentManager.Instance.CurrentDBDocument
uidoc = DocumentManager.Instance.CurrentUIApplication.ActiveUIDocument
uiapp = DocumentManager.Instance.CurrentUIApplication
app = uiapp.Application

def Average(lst): 
    return sum(lst) / len(lst) 
    
# Create Empty List
areas = []
for s in surfs:
	areas.append(s.Area)
avg = Average(areas)/100

goodsurfs = []
count = 0
for a in areas:
	if a > avg:
		goodsurfs.append(surfs[count])
	count += 1
# Assign your output to the OUT variable.
OUT = goodsurfs
# ----------------------------------------
perimeterCurves = Surface.PerimeterCurves(surface=python_script)
simplify = Custom[SP.CurveLoop.Simplify](VARcurveLoop=perimeterCurves)  # Attempts to simplify an open or a closed curve loop by connecting straight separate line segments into a single line.
startPoint = Curve.StartPoint(curve=simplify)
VARPointTolerance = Input(VARPointTolerance: var[]..[])
pruneDuplicates = Point.PruneDuplicates(points=startPoint@L2, tolerance=VARPointTolerance)
UVParameterAtPoint = Surface.UVParameterAtPoint(surface=firstItem, point=pruneDuplicates)
U = UV.U(uV=UVParameterAtPoint)
V = UV.V(uV=UVParameterAtPoint)
python_script_2 = Python(IN[0]=flatten, IN[1]=U, IN[2]=V)
# ---------- python_script_2.python (110 lines) ----------
# Enable Python support and load DesignScript library
# IMPORTANT : ALL DYNAMO DESIGN SCRIPT NODES ARE AS (dg)
import clr
clr.AddReference('ProtoGeometry')
from Autodesk.DesignScript import Geometry as dg

# EXTENSION Enable ToDSType
clr.AddReference('RevitNodes')
import Revit
clr.ImportExtensions(Revit.Elements)

# Enable Revit Elements
from Revit.Elements import *

# EXTENSION Enable Geometry Conversion Methods
clr.ImportExtensions(Revit.GeometryConversion)

# Enable Revit API
clr.AddReference('RevitAPI')
from Autodesk.Revit.DB import *

# Enable DocumentManager and TransactionManager
clr.AddReference('RevitServices')
from RevitServices.Persistence import DocumentManager
from RevitServices.Transactions import TransactionManager

# Enable ICollection List Translate
clr.AddReference("System")
import System.Collections.Generic
from System.Collections.Generic import List

def flatten(x):
    result = []
    for el in x:
        if hasattr(el, "__iter__") and not isinstance(el, basestring):
            result.extend(flatten(el))
        else:
            result.append(el)
    return result

dataEnteringNode = IN
# Use UnwrapElement(IN[0]) When Translating From Dynamo to Revit
surfs = UnwrapElement(IN[0])
us = UnwrapElement(IN[1])
vs = UnwrapElement(IN[2])

# Choose The Current Document
doc = DocumentManager.Instance.CurrentDBDocument
uidoc = DocumentManager.Instance.CurrentUIApplication.ActiveUIDocument
uiapp = DocumentManager.Instance.CurrentUIApplication
app = uiapp.Application

def op(s,us,vs):
	count = 0
	tmpbig = []
	for currentu in us:
		currentv = vs[count]
		count += 1
		tmp = []
		innercount = 0
		for cu in currentu:
			cv = currentv[innercount]
			tmp.append(dg.Surface.PointAtParameter(s,cu,cv))
			innercount += 1
		tmpbig.append(tmp)
	return tmpbig

def alter(us):
	newus = []
	for listu in us:
		fixedu  = []
		for e in listu:
			fixedu.append(1 - e)
		newus.append(fixedu)
	return newus

def check(s,pack):
	flattenpack = flatten(pack)
	restartmode = False
	faul = []
	for f in flattenpack:
		if dg.Geometry.DistanceTo(s,f) > 0.1:
			faul.append(True)
			if len(faul) == 3:
				restartmode = True
				break
	return restartmode

# Create Empty List
result = []

for s in surfs:
	pack = op(s,us,vs)
	if check(s,pack) == False:
		result.append(pack)
	else:
		pack = op(s,alter(us),vs)
		if check(s,pack) == False:
			result.append(pack)
		else:
			pack = op(s,us,alter(vs))
			if check(s,pack) == False:
				result.append(pack)
			else:
				pack = op(s,alter(us),alter(vs))
				if check(s,pack) == False:
					result.append(pack)

# Assign your output to the OUT variable.
OUT = result
# ----------------------------------------
count = List.Count()  # unwired: list
sortByFunction = List.SortByFunction(list=python_script_2@@L3, func=count)
groupByFunction = List.GroupByFunction(list=sortByFunction@@L3, func=count)
count_2 = List.Count(list=groupByFunction@@L2)
firstItem_2 = List.FirstItem(list=count_2@@L2)
transpose = List.Transpose(lists=firstItem_2)
firstItem_3 = List.FirstItem(list=transpose@L2)
string_from_object = FromObject(obj=firstItem_3)
code_block = CodeBlock { "."; }
split = String.Split(str=string_from_object, separator0=code_block)
firstItem_4 = List.FirstItem(list=split@L2)
count_3 = List.Count(list=count_2@@L2)
transpose_2 = List.Transpose(lists=count_3)
sum = Math.Sum(values=transpose_2@L2)
string_from_object_2 = FromObject(obj=sum)
string_from_object_3 = FromObject(obj=string_from_object_2)
code_block_2 = CodeBlock { "."; }
split_2 = String.Split(str=string_from_object_3, separator0=code_block_2)
firstItem_5 = List.FirstItem(list=split_2@L2)
python_script_3 = Python(IN[0]=firstItem_4, IN[1]=firstItem_5)
# ---------- python_script_3.python (32 lines) ----------
import clr
clr.AddReference('ProtoGeometry')
from Autodesk.DesignScript.Geometry import *
#The inputs to this node will be stored as a list in the IN variables.
dataEnteringNode = IN

strings = IN[0]
count = IN[1]

result = []
try:
	result.append(count[0] + " Primary Panels " + "With " + strings[0] + " Points")
except : pass

try:
	result.append(count[1] + " Secondary Panels " + "With " + strings[1] + " Points")
except : pass

try:
	result.append(count[2] + " Tertiary Panels " + "With " + strings[2] + " Points")
except : pass

try:
	result.append(count[3] + " Quaternary Panels " + "With " + strings[3] + " Points")
except : pass

try:
	result.append(count[4] + " Quinary Panels " + "With " + strings[4] + " Points")
except : pass

#Assign your output to the OUT variable.
OUT = result
# ----------------------------------------
VARReport = Output(python_script_3)
code_block_3 = CodeBlock { 0; 1; 2; 3; 4; }
getItemAtIndex = List.GetItemAtIndex(list=groupByFunction@L4, index=code_block_3.out0)
code_block_4 = CodeBlock { false; }
clean = List.Clean(list=getItemAtIndex, preserveIndices=code_block_4)
VARPrimary = Output(clean)
getItemAtIndex_2 = List.GetItemAtIndex(list=groupByFunction@L4, index=code_block_3.out1)
clean_2 = List.Clean(list=getItemAtIndex_2, preserveIndices=code_block_4)
VARSecondary = Output(clean_2)
getItemAtIndex_3 = List.GetItemAtIndex(list=groupByFunction@L4, index=code_block_3.out2)
clean_3 = List.Clean(list=getItemAtIndex_3, preserveIndices=code_block_4)
VARTertiary = Output(clean_3)
getItemAtIndex_4 = List.GetItemAtIndex(list=groupByFunction@L4, index=code_block_3.out3)
clean_4 = List.Clean(list=getItemAtIndex_4, preserveIndices=code_block_4)
VARQuaternary = Output(clean_4)
getItemAtIndex_5 = List.GetItemAtIndex(list=groupByFunction@L4, index=code_block_3.out4)
clean_5 = List.Clean(list=getItemAtIndex_5, preserveIndices=code_block_4)
VARQuinary = Output(clean_5)
VARShowPolygons = Input(VARShowPolygons: var[]..[])
empty = List.Empty()
scopeIf = Custom[CW.ScopeIf+](VARtest=VARShowPolygons, VARtrue=groupByFunction, VARfalse=empty)  # A (hopefully) more robust implementation of ScopeIf. Tests a single boolean and returns a value accordingly.
byPoints = Polygon.ByPoints(points=scopeIf)
python_null_2_empty = Custom[Python Null 2 Empty](VARIN=byPoints)  # Python Null 2 Empty
VARPolygons = Output(python_null_2_empty)
