# Dynamo custom node Map Revit Panels.dyf (Dynamo 2.1.0.7500)
# category: Synthesize.Automate.Adaptive
# Map Revit Panels

byOriginNormal = Plane.ByOriginNormal()
byWidthLength = Rectangle.ByWidthLength(plane=byOriginNormal)
byPatch = Surface.ByPatch(closedCurve=byWidthLength)
byOriginNormal_2 = Plane.ByOriginNormal()
VARFamilyType = Input(VARFamilyType: var[]..[])
adaptive_family_orientation_type = Custom[Adaptive Family Orientation Type](VARFamilyType=VARFamilyType)  # Adaptive Family Orientation Type (Along With Other Useful Information
max = Math.Max(int1=adaptive_family_orientation_type.VARVerticalSpacing, int2=adaptive_family_orientation_type.VARHorizontalSpacing)
VARvDivs = Input(VARvDivs: int)
mul = max * VARvDivs
VARuDivs = Input(VARuDivs: int)
mul_2 = max * VARuDivs
byWidthLength_2 = Rectangle.ByWidthLength(plane=byOriginNormal_2, width=mul, length=mul_2)
byPatch_2 = Surface.ByPatch(closedCurve=byWidthLength_2)
code_block = CodeBlock { true; }
dynamo_geometry_to_revit = Custom[Dynamo Geometry To Revit Compatibility](VARGeometryOrSat=byPatch_2, VARPreferImportInstance=code_block)  # Dynamo Geometry To Revit Compatibility
faces = Element.Faces(element=dynamo_geometry_to_revit)
code_block_2 = CodeBlock(a=faces) { a[0]; }
VARgridRotation = Input(VARgridRotation: double)
byFaceUVDivisionsAndRotation = DividedSurface.ByFaceUVDivisionsAndRotation(surface=faces, uDivs=VARuDivs, vDivs=VARvDivs, gridRotation=VARgridRotation)
code_block_3 = CodeBlock { "Family and Type"; }
setParameterByName = Element.SetParameterByName(element=byFaceUVDivisionsAndRotation, parameterName=code_block_3, value=VARFamilyType)
code_block_4 = CodeBlock(a=setParameterByName) { a[0]; }
end = Revit.Transaction.Transaction.End(input=code_block_4)
passthrough = Custom[CW.Passthrough](VARpassThrough=VARFamilyType, VARwaitFor=end)  # Forces a sequential order of execution. The node wired into the output of the Passthrough node will be executed *after* the node wired into the waitFor input (e.g. important for some Revit operations). The value of the passThrough input will be passed on to the node wired into the output port of the Passthrough node.
all_elements_of_family_type = ElementsOfFamilyType(Family_Type=passthrough)
all_elements_of_family_type_2 = ElementsOfFamilyType(Family_Type=VARFamilyType)
removeListFromList = Custom[RH.RemoveListFromList](VARListA=all_elements_of_family_type, VARListB=all_elements_of_family_type_2)  # This node essentially "subtracts" the contents of List B from List A to produce a new list with the unique items.
location_of_any_element = Custom[Location Of Any Element](VARElements=removeListFromList)  # Location Of Any Element
byPatch_3 = Surface.ByPatch(closedCurve=location_of_any_element.VARLocations)
python_script = Python(IN[0]=faces, IN[1]=byPatch_3, IN[2]=adaptive_family_orientation_type.VARPatternType, IN[3]=dynamo_geometry_to_revit)
# ---------- python_script.python (78 lines) ----------
# Enable Python support and load DesignScript library
# IMPORTANT : ALL DYNAMO DESIGN SCRIPT NODES ARE AS (dg)
import clr
clr.AddReference('ProtoGeometry')
from Autodesk.DesignScript import Geometry as dg

# EXTENSION Enable ToDSType
clr.AddReference('RevitNodes')
import Revit
clr.ImportExtensions(Revit.Elements)

# Enable Revit Elements
from Revit.Elements import *

# EXTENSION Enable Geometry Conversion Methods
clr.ImportExtensions(Revit.GeometryConversion)

# Enable Revit API
clr.AddReference('RevitAPI')
from Autodesk.Revit.DB import *

# Enable DocumentManager and TransactionManager
clr.AddReference('RevitServices')
from RevitServices.Persistence import DocumentManager
from RevitServices.Transactions import TransactionManager

# Enable ICollection List Translate
clr.AddReference("System")
import System.Collections.Generic
from System.Collections.Generic import List

# Choose The Current Document
doc = DocumentManager.Instance.CurrentDBDocument
uidoc = DocumentManager.Instance.CurrentUIApplication.ActiveUIDocument
uiapp = DocumentManager.Instance.CurrentUIApplication
app = uiapp.Application

mainsurf = UnwrapElement(IN[0])
minisurfs = UnwrapElement(IN[1])
condi = UnwrapElement(IN[2])

if condi == "Octagon" or condi == "OctagonRotate":

	mainsol = dg.Surface.Thicken(mainsurf[0],1,False)
	minisols = []

	for e in minisurfs:
		minisols.append(dg.Surface.Thicken(e,1,False))

	diff = dg.Solid.DifferenceAll(mainsol, minisols)

	for e in minisols:
		e.Dispose()

	mainsol.Dispose()

	exploded = dg.Geometry.Explode(diff)

	surfs = []
	for e in exploded:
		tmpvec = dg.Surface.NormalAtParameter(e,0.5,0.5)
		if dg.Vector.IsAlmostEqualTo(tmpvec,dg.Vector.ZAxis().Reverse()):
			surfs.append(e.PerimeterCurves())
	
	diff.Dispose()

	for e in exploded:
		e.Dispose()
else:
	surfs = []
	
elemtodel = UnwrapElement(IN[3])

elt = elemtodel.Id
doc.Delete(elt)

#Assign your output to the OUT variable.
OUT = surfs
# ----------------------------------------
intersectAll = Geometry.IntersectAll(geometry=byPatch_3, others=faces)
flatten = List.Flatten(list=intersectAll)
perimeterCurves = Surface.PerimeterCurves(surface=flatten)
create = List.Create(item0=python_script, item1=perimeterCurves)
code_block_5 = CodeBlock { false; }
clean = List.Clean(list=create, preserveIndices=code_block_5)
flatten_2 = List.Flatten(list=clean@L2)
startPoint = Curve.StartPoint(curve=flatten_2)
UVParameterAtPoint = Surface.UVParameterAtPoint(surface=code_block_2, point=startPoint)
U = UV.U(uV=UVParameterAtPoint)
V = UV.V(uV=UVParameterAtPoint)
pointAtParameter = Surface.PointAtParameter(surface=byPatch, u=U, v=V)
clockwise_points_sorter = Custom[Clockwise Points Sorter](VARPoints=pointAtParameter, VAROriginalPoints=startPoint)  # Clockwise Points Sorter
VARPointsTolerance = Input(VARPointsTolerance: var[]..[])
pruneDuplicates = Point.PruneDuplicates(points=clockwise_points_sorter, tolerance=VARPointsTolerance)
count = List.Count()  # unwired: list
sortByFunction = List.SortByFunction(list=pruneDuplicates, func=count)
groupByFunction = List.GroupByFunction(list=sortByFunction, func=count)
count_2 = List.Count(list=groupByFunction@@L2)
firstItem = List.FirstItem(list=count_2@L2)
string_from_object = FromObject(obj=firstItem)
code_block_6 = CodeBlock { "."; }
split = String.Split(str=string_from_object, separator0=code_block_6)
firstItem_2 = List.FirstItem(list=split@L2)
count_3 = List.Count(list=count_2@L2)
string_from_object_2 = FromObject(obj=count_3)
string_from_object_3 = FromObject(obj=string_from_object_2)
code_block_7 = CodeBlock { "."; }
split_2 = String.Split(str=string_from_object_3, separator0=code_block_7)
firstItem_3 = List.FirstItem(list=split_2@L2)
python_script_2 = Python(IN[0]=firstItem_2, IN[1]=firstItem_3)
# ---------- python_script_2.python (32 lines) ----------
import clr
clr.AddReference('ProtoGeometry')
from Autodesk.DesignScript.Geometry import *
#The inputs to this node will be stored as a list in the IN variables.
dataEnteringNode = IN

strings = IN[0]
count = IN[1]

result = []
try:
	result.append(count[0] + " Primary Panels " + "With " + strings[0] + " Points")
except : pass

try:
	result.append(count[1] + " Secondary Panels " + "With " + strings[1] + " Points")
except : pass

try:
	result.append(count[2] + " Tertiary Panels " + "With " + strings[2] + " Points")
except : pass

try:
	result.append(count[3] + " Quaternary Panels " + "With " + strings[3] + " Points")
except : pass

try:
	result.append(count[4] + " Quinary Panels " + "With " + strings[4] + " Points")
except : pass

#Assign your output to the OUT variable.
OUT = result
# ----------------------------------------
VARReport = Output(python_script_2)
VARSurfaces = Input(VARSurfaces: Autodesk.DesignScript.Geometry.Surface)
UVParameterAtPoint_2 = Surface.UVParameterAtPoint(surface=code_block_2, point=groupByFunction)
U_2 = UV.U(uV=UVParameterAtPoint_2)
V_2 = UV.V(uV=UVParameterAtPoint_2)
pointAtParameter_2 = Surface.PointAtParameter(surface=VARSurfaces@L1, u=U_2, v=V_2)
code_block_8 = CodeBlock { 0; 1; 2; 3; 4; }
getItemAtIndex = List.GetItemAtIndex(list=pointAtParameter_2@L4, index=code_block_8.out0)
code_block_9 = CodeBlock { false; }
clean_2 = List.Clean(list=getItemAtIndex, preserveIndices=code_block_9)
VARPrimary = Output(clean_2)
getItemAtIndex_2 = List.GetItemAtIndex(list=pointAtParameter_2@L4, index=code_block_8.out1)
clean_3 = List.Clean(list=getItemAtIndex_2, preserveIndices=code_block_9)
VARSecondary = Output(clean_3)
getItemAtIndex_3 = List.GetItemAtIndex(list=pointAtParameter_2@L4, index=code_block_8.out2)
clean_4 = List.Clean(list=getItemAtIndex_3, preserveIndices=code_block_9)
VARTertiary = Output(clean_4)
getItemAtIndex_4 = List.GetItemAtIndex(list=pointAtParameter_2@L4, index=code_block_8.out3)
clean_5 = List.Clean(list=getItemAtIndex_4, preserveIndices=code_block_9)
VARQuaternary = Output(clean_5)
getItemAtIndex_5 = List.GetItemAtIndex(list=pointAtParameter_2@L4, index=code_block_8.out4)
clean_6 = List.Clean(list=getItemAtIndex_5, preserveIndices=code_block_9)
VARQuinary = Output(clean_6)
VARShowPolygons = Input(VARShowPolygons: var[]..[])
empty = List.Empty()
scopeIf = Custom[CW.ScopeIf+](VARtest=VARShowPolygons, VARtrue=pointAtParameter_2, VARfalse=empty)  # A (hopefully) more robust implementation of ScopeIf. Tests a single boolean and returns a value accordingly.
byPoints = Polygon.ByPoints(points=scopeIf)
python_null_2_empty = Custom[Python Null 2 Empty](VARIN=byPoints)  # Python Null 2 Empty
VARPolygons = Output(python_null_2_empty)
VARJunkSurface = Output(dynamo_geometry_to_revit)
