# Dynamo custom node Mass Floor Lines Intersects.dyf (Dynamo 2.1.0.7500)
# category: Synthesize.Automate.Lines
# Mass Floor Lines Intersects

VARSurfaces = Input(VARSurfaces: var[]..[])
flatten = List.Flatten(list=VARSurfaces)
code_block = CodeBlock { "Surface"; }
byClassName = Custom[SP.Filter.ByClassName](VARobject=flatten, VARclassName=code_block)  # Filters a list of objects by the object's class name. Note that Dynamo elements belong to different classes than their Revit counterparts. Use the Object.Class node to check an object's class.
flatten_2 = List.Flatten(list=byClassName.VARin)
VARLevels = Input(VARLevels: var[]..[])
code_block_2 = CodeBlock { "Level"; }
byClassName_2 = Custom[SP.Filter.ByClassName](VARobject=VARLevels, VARclassName=code_block_2)
flatten_3 = List.Flatten(list=byClassName_2.VARin)
plane = Custom[CW.Level.Plane](VARlevel=flatten_3)  # Retrieves the plane of a given level
intersect = Geometry.Intersect(geometry=flatten_2, other=plane@L1)
flatten_4 = List.Flatten(list=intersect@L3)
code_block_3 = CodeBlock { "Surface"; "Point"; }
byClassName_3 = Custom[SP.Filter.ByClassName](VARobject=flatten_4, VARclassName=code_block_3.out0)
byClassName_4 = Custom[SP.Filter.ByClassName](VARobject=byClassName_3.VARout, VARclassName=code_block_3.out1)
code_block_4 = CodeBlock { 3; }
normalizeDepth = List.NormalizeDepth(list=byClassName_4.VARout, rank=code_block_4)
code_block_5 = CodeBlock { 0; }
curves_offset_to_revit = Custom[Curves Offset To Revit Compatibility](VARCurves=normalizeDepth@L3, VAROffset=code_block_5)  # Curves Offset To Revit Compatibility
flatten_5 = List.Flatten(list=curves_offset_to_revit.VARRevitCurves@L3)
flatten_6 = List.Flatten(list=curves_offset_to_revit.VARCurves@L3)
python_script = Python(IN[0]=flatten_5, IN[1]=flatten_6, IN[2]=flatten_3)
# ---------- python_script.python (68 lines) ----------
# Created By Karam Baki : karam@aecedx.com
# Enable Python support and load DesignScript library
# IMPORTANT : ALL DYNAMO DESIGN SCRIPT NODES ARE AS (dg)
import clr
clr.AddReference('ProtoGeometry')
from Autodesk.DesignScript import Geometry as dg

# EXTENSION Enable ToDSType
clr.AddReference('RevitNodes')
import Revit
clr.ImportExtensions(Revit.Elements)

# Enable Revit Elements
from Revit.Elements import *

# EXTENSION Enable Geometry Conversion Methods
clr.ImportExtensions(Revit.GeometryConversion)

# Enable Revit API
clr.AddReference('RevitAPI')
from Autodesk.Revit.DB import *

# Enable DocumentManager and TransactionManager
clr.AddReference('RevitServices')
from RevitServices.Persistence import DocumentManager
from RevitServices.Transactions import TransactionManager

# Choose The Current Document
doc = DocumentManager.Instance.CurrentDBDocument

Curvelists = IN[0]
Purecurves = IN[1]
levels = UnwrapElement(IN[2])

# EXTENSION Enable Geometry Conversion Methods
clr.ImportExtensions(Revit.GeometryConversion)

if doc.IsFamilyDocument: 
	doc_create = doc.FamilyCreate
else: 
	doc_create = doc.Create

result = []

TransactionManager.Instance.EnsureInTransaction(doc)
count = 0
for l in levels:
	tmp = []
	plane = SketchPlane.Create(doc, l.Id)
	cur_curves = Curvelists[count]
	pure_curves = Purecurves[count]
	count += 1
	innercount = 0
	for s in cur_curves:
		p = pure_curves[innercount]
		try:
			modline = doc_create.NewModelCurve(s,plane)
		except:
			try:
				modline = UnwrapElement(Revit.Elements.ModelCurve.ByCurve(s))
			except:
				pass
		innercount += 1
		tmp.append(modline)
	result.append(tmp)
TransactionManager.Instance.TransactionTaskDone()

OUT = result
# ----------------------------------------
VARModelCurves = Output(python_script)
VARCreateSelectionFilter = Input(VARCreateSelectionFilter: var[]..[])
VARFilterNametoCreate = Input(VARFilterNametoCreate: var[]..[])
VAROverwriteExistingFilter = Input(VAROverwriteExistingFilter: var[]..[])
generate_selection_filter = Custom[Generate Selection Filter](VARCreateSelectionFilter=VARCreateSelectionFilter, VARFilterNametoCreate=VARFilterNametoCreate, VAROverwriteExistingFilter=VAROverwriteExistingFilter, VARElements=python_script)  # Generate Selection FIlter
VARSelectionSet = Output(generate_selection_filter.VARSelectionSet)
