# Dynamo custom node Mass Split.dyf (Dynamo 2.1.0.7500)
# category: Synthesize.Automate.Solid
# Mass Split

VARSplittingLines = Input(VARSplittingLines: var[]..[])
code_block = CodeBlock { "ReferencePoint"; "CurveByPoints"; }
byClassName = Custom[SP.Filter.ByClassName](VARobject=VARSplittingLines, VARclassName=code_block.out0)  # Filters a list of objects by the object's class name. Note that Dynamo elements belong to different classes than their Revit counterparts. Use the Object.Class node to check an object's class.
byClassName_2 = Custom[SP.Filter.ByClassName](VARobject=byClassName.VARout, VARclassName=code_block.out1)
element_geometry_fast = Custom[Element.Geometry Fast](VARElements=byClassName_2.VARout)  # Element.Geometry Fast
flatten = List.Flatten(list=element_geometry_fast)
helix_to_curves = Custom[Helix to Curves](VARHelixElements=byClassName_2.VARin)  # Helix to Curves
create = List.Create(item0=flatten, item1=helix_to_curves)
code_block_2 = CodeBlock { false; }
clean = List.Clean(list=create, preserveIndices=code_block_2)
flatten_2 = List.Flatten(list=clean)
code_block_3 = CodeBlock { "Solid"; }
byClassName_3 = Custom[SP.Filter.ByClassName](VARobject=flatten_2, VARclassName=code_block_3)
python_empty_2_null = Custom[Python Empty 2 Null](VARIN=byClassName_3.VARout)  # Python Null 2 Empty
code_block_4 = CodeBlock { "Surface"; }
byClassName_4 = Custom[SP.Filter.ByClassName](VARobject=python_empty_2_null, VARclassName=code_block_4)
VARElements = Input(VARElements: var[]..[])
element_geometry_fast_2 = Custom[Element.Geometry Fast](VARElements=VARElements)
code_block_5 = CodeBlock { "Solid"; }
byClassName_5 = Custom[SP.Filter.ByClassName](VARobject=element_geometry_fast_2, VARclassName=code_block_5)
code_block_6 = CodeBlock { false; }
clean_2 = List.Clean(list=byClassName_5.VARin, preserveIndices=code_block_6)
explode = Geometry.Explode(geometry=clean_2)
code_block_7 = CodeBlock { false; }
clean_3 = List.Clean(list=explode, preserveIndices=code_block_7)
python_empty_2_null_2 = Custom[Python Empty 2 Null](VARIN=byClassName_5.VARout)
code_block_8 = CodeBlock { "Surface"; }
byClassName_6 = Custom[SP.Filter.ByClassName](VARobject=python_empty_2_null_2, VARclassName=code_block_8)
python_empty_2_null_3 = Custom[Python Empty 2 Null](VARIN=byClassName_6.VARin)
create_2 = List.Create(item0=clean_3, item1=python_empty_2_null_3)
clean_4 = List.Clean(list=create_2, preserveIndices=code_block_7)
flatten_3 = List.Flatten(list=clean_4@L3)
VARSplitterThickness = Input(VARSplitterThickness: double)
VARDetectionTollerance = Input(VARDetectionTollerance: double)
VARSplitExtendDistance = Input(VARSplitExtendDistance: double)
VARPointsDistancing = Input(VARPointsDistancing: double)
VARPullOrNot = Input(VARPullOrNot: bool)
auto_build_intersecting_surfaces = Custom[Auto Build Intersecting Surfaces On Surfaces](VARSplittingLines=byClassName_4.VARout, VARSurfaces=flatten_3@L2, VARSplitterThickness=VARSplitterThickness, VARDetectionTollerance=VARDetectionTollerance, VARSplitExtendDistance=VARSplitExtendDistance, VARPointsDistancing=VARPointsDistancing, VARPullOrNot=VARPullOrNot)  # Auto Build Intersecting Surfaces On Surfaces
code_block_9 = CodeBlock { false; }
join_adjacent_surfaces_legacy = Custom[Join Adjacent Surfaces Legacy](VARSurfaces=auto_build_intersecting_surfaces, VARNormalsCheck=code_block_9)  # Join Adjacent Surfaces
flatten_4 = List.Flatten(list=join_adjacent_surfaces_legacy)
python_script = Python(IN[0]=flatten_4)
# ---------- python_script.python (61 lines) ----------
# Enable Python support and load DesignScript library
# IMPORTANT : ALL DYNAMO DESIGN SCRIPT NODES ARE AS (dg)
import clr
clr.AddReference('ProtoGeometry')
from Autodesk.DesignScript import Geometry as dg

# EXTENSION Enable ToDSType
clr.AddReference('RevitNodes')
import Revit
clr.ImportExtensions(Revit.Elements)

# Enable Revit Elements
from Revit.Elements import *

# EXTENSION Enable Geometry Conversion Methods
clr.ImportExtensions(Revit.GeometryConversion)

# Enable Revit API
clr.AddReference('RevitAPI')
from Autodesk.Revit.DB import *

# Enable DocumentManager and TransactionManager
clr.AddReference('RevitServices')
from RevitServices.Persistence import DocumentManager
from RevitServices.Transactions import TransactionManager

# Enable ICollection List Translate
clr.AddReference("System")
import System.Collections.Generic
from System.Collections.Generic import List

dataEnteringNode = IN
# Use UnwrapElement(IN[0]) When Translating From Dynamo to Revit
inside=UnwrapElement(IN[0])

# Choose The Current Document
doc = DocumentManager.Instance.CurrentDBDocument
uidoc = DocumentManager.Instance.CurrentUIApplication.ActiveUIDocument
uiapp = DocumentManager.Instance.CurrentUIApplication
app = uiapp.Application

# Create Empty List
result = []

#ilistofids.Add(elements.Id)

for each in inside:
	try:
		exploded = dg.Geometry.Explode(each)
		tmp = []
		for e in exploded:
			tmp.append(dg.Surface.Offset(e,0))
		if hasattr(each, 'Surfaces') and len(tmp) != 1:
			result.append(dg.PolySurface.ByJoinedSurfaces(tmp))
		else:
			result.append(tmp[0])
	except:
		result.append(each)

# Assign your output to the OUT variable.
OUT = result
# ----------------------------------------
code_block_10 = CodeBlock { 1; }
chop = List.Chop(list=python_script, lengths=code_block_10)
python_script_2 = Python(IN[0]=chop)
# ---------- python_script_2.python (57 lines) ----------
# Enable Python support and load DesignScript library
# IMPORTANT : ALL DYNAMO DESIGN SCRIPT NODES ARE AS (dg)
import clr
clr.AddReference('ProtoGeometry')
from Autodesk.DesignScript import Geometry as dg

# EXTENSION Enable ToDSType
clr.AddReference('RevitNodes')
import Revit
clr.ImportExtensions(Revit.Elements)

# Enable Revit Elements
from Revit.Elements import *

# EXTENSION Enable Geometry Conversion Methods
clr.ImportExtensions(Revit.GeometryConversion)

# Enable Revit API
clr.AddReference('RevitAPI')
from Autodesk.Revit.DB import *

# Enable DocumentManager and TransactionManager
clr.AddReference('RevitServices')
from RevitServices.Persistence import DocumentManager
from RevitServices.Transactions import TransactionManager

# Enable ICollection List Translate
clr.AddReference("System")
import System.Collections.Generic
from System.Collections.Generic import List

dataEnteringNode = IN
# Use UnwrapElement(IN[0]) When Translating From Dynamo to Revit
inside=UnwrapElement(IN[0])

# Choose The Current Document
doc = DocumentManager.Instance.CurrentDBDocument
uidoc = DocumentManager.Instance.CurrentUIApplication.ActiveUIDocument
uiapp = DocumentManager.Instance.CurrentUIApplication
app = uiapp.Application

# Create Empty List
result = []

#ilistofids.Add(elements.Id)

for eachlist in inside:
	tmp = []
	for e in eachlist:
		if e != None:
			try:
				tmp.append(dg.Solid.ByJoinedSurfaces(e.Surfaces()))
			except:
				tmp.append(e)
	result.append(tmp)
# Assign your output to the OUT variable.
OUT = result
# ----------------------------------------
flatten_5 = List.Flatten(list=python_script_2)
VARGeometry = Output(flatten_5)
