# Dynamo custom node MillimetersInput.dyf (Dynamo 2.1.0.7500)
# category: Synthesize.Fixers
# MetersInput

VARInput = Input(VARInput: var[]..[])
convert_between_units = DynamoConvert(VARInput, MeasurementType="Length", FromConversion="Millimeters", ToConversion="Feet")
unit_types = UnitTypes("Length")
displayUnitType = Custom[CW.UnitType.DisplayUnitType](VARunitType=unit_types)  # Retrieves the display unit type for a given unit type.
toDisplayUnit = Custom[CW.InternalUnit.ToDisplayUnit](VARval=convert_between_units, VARdisplayUnitType=displayUnitType.VARdisplayUnitType)  # Converts a value from Revit's internal unit to a given display unit
VAROutput = Output(toDisplayUnit)
