# Dynamo custom node Model Curve Build Checker.dyf (Dynamo 2.1.0.7500)
# category: Synthesize.Automate.Lines
# Model Curve Build Checker

VARCurves = Input(VARCurves: var[]..[])
python_script = Python(IN[0]=VARCurves)
# ---------- python_script.python (70 lines) ----------
# Enable Python support and load DesignScript library
# IMPORTANT : ALL DYNAMO DESIGN SCRIPT NODES ARE AS (dg)
import clr
clr.AddReference('ProtoGeometry')
from Autodesk.DesignScript import Geometry as dg

# EXTENSION Enable ToDSType
clr.AddReference('RevitNodes')
import Revit
clr.ImportExtensions(Revit.Elements)

# Enable Revit Elements
from Revit.Elements import *

# EXTENSION Enable Geometry Conversion Methods
clr.ImportExtensions(Revit.GeometryConversion)

# Enable Revit API
clr.AddReference('RevitAPI')
from Autodesk.Revit.DB import *

# Enable DocumentManager and TransactionManager
clr.AddReference('RevitServices')
from RevitServices.Persistence import DocumentManager
from RevitServices.Transactions import TransactionManager

# Enable ICollection List Translate
clr.AddReference("System")
import System.Collections.Generic
from System.Collections.Generic import List

dataEnteringNode = IN
# Use UnwrapElement(IN[0]) When Translating From Dynamo to Revit
curves=UnwrapElement(IN[0])

# Choose The Current Document
doc = DocumentManager.Instance.CurrentDBDocument
uidoc = DocumentManager.Instance.CurrentUIApplication.ActiveUIDocument
uiapp = DocumentManager.Instance.CurrentUIApplication
app = uiapp.Application

# Create Empty List
built = []
goodcurves = []
for c in curves:
	try:
		built.append(Revit.Elements.ModelCurve.ByCurve(c))
		goodcurves.append(c)
	except:
		try:
			stp = c.StartPoint
			ste = c.EndPoint
			line = dg.Line.ByStartPointEndPoint(stp,ste)
			goodcurves.append(line)
		except:
			goodcurves.append(None)
			
# Start a Transaction with Current Document (doc)
TransactionManager.Instance.EnsureInTransaction(doc)

for b in built:
	try:
		doc.Delete(UnwrapElement(b).Id)
	except:
		pass
	
# End the Transaction with Current Document ()
TransactionManager.Instance.TransactionTaskDone()
# Assign your output to the OUT variable.
OUT = goodcurves
# ----------------------------------------
VARCurves_2 = Output(python_script)  # "VARCurves"
