# Dynamo custom node Model Curve By Pair Points.dyf (Dynamo 2.1.0.7500)
# category: Synthesize.Automate.Lines

VARFirstPoint = Input(VARFirstPoint: var[]..[])
geometry = Element.Geometry(element=VARFirstPoint)
VARPairs = Input(VARPairs: var[]..[])
VARReferencePoints = Input(VARReferencePoints: var[]..[])
code_block = CodeBlock { "Reference Point"; }
filterByString = Custom[ST.List.FilterByString](VARlist=VARReferencePoints, VARString=code_block)  # Filter a list by a string match
geometry_2 = Element.Geometry(element=filterByString.VARMatch)
flatten = List.Flatten(list=geometry_2)
X = Point.X(point=VARFirstPoint)
Y = Point.Y(point=VARFirstPoint)
Z = Point.Z(point=VARFirstPoint)
code_block_2 = CodeBlock { 0.01; }
add = Z + code_block_2
dm_fix_point_bycoordinates_range = Custom[DM.Fix Point.ByCoordinates Range](VARx=X, VARy=Y, VARz=add)  # Dummy Node to fix the modelling range warning
sortByDistance = Custom[LF.Points.SortByDistance](VARpoints=flatten, VARbasePoint=dm_fix_point_bycoordinates_range, VARelements=filterByString.VARMatch)  # Sort a list of points based on their distance from a specified point
subpairs = Custom[SP.List.Subpairs](VARlist=sortByDistance)  # Pair up each list item with the next one and drop the list item.
code_block_3 = CodeBlock { null; false; }
scopeIf = Custom[CW.ScopeIf+](VARtest=VARPairs, VARtrue=subpairs, VARfalse=code_block_3.out0)  # A (hopefully) more robust implementation of ScopeIf. Tests a single boolean and returns a value accordingly.
scopeIf_2 = Custom[CW.ScopeIf+](VARtest=VARPairs, VARtrue=code_block_3.out0, VARfalse=sortByDistance)
join = List.Join(list0=scopeIf, list1=scopeIf_2)
clean = List.Clean(list=join, preserveIndices=code_block_3.out1)
byReferencePoints = CurveByPoints.ByReferencePoints(points=clean)
code_block_4 = CodeBlock { "Is Reference Line"; }
VARIsReference = Input(VARIsReference: var[]..[])
code_block_5 = CodeBlock { 0; 1; }
scopeIf_3 = Custom[CW.ScopeIf+](VARtest=VARIsReference, VARtrue=code_block_5.out1, VARfalse=code_block_5.out0)
setParameterByName = Element.SetParameterByName(element=byReferencePoints, parameterName=code_block_4, value=scopeIf_3)
VARElement = Output(setParameterByName)
