# Dynamo custom node Move Dimension Text to Middle.dyf (Dynamo 2.1.0.7500)
# category: Synthesize.Automate.Dimensions
# Move Dimension Text to Middle

VARElements = Input(VARElements: var[]..[])
code_block = CodeBlock { "Dimension"; }
byClassName = Custom[SP.Filter.ByClassName](VARobject=VARElements, VARclassName=code_block)  # Filters a list of objects by the object's class name. Note that Dynamo elements belong to different classes than their Revit counterparts. Use the Object.Class node to check an object's class.
python_script = Python(IN[0]=byClassName.VARin)
# ---------- python_script.python (56 lines) ----------
# Enable Python support and load DesignScript library
# IMPORTANT : ALL DYNAMO DESIGN SCRIPT NODES ARE AS (dg)
import clr
clr.AddReference('ProtoGeometry')
from Autodesk.DesignScript import Geometry as dg

# EXTENSION Enable ToDSType
clr.AddReference('RevitNodes')
import Revit
clr.ImportExtensions(Revit.Elements)

# Enable Revit Elements
from Revit.Elements import *

# EXTENSION Enable Geometry Conversion Methods
clr.ImportExtensions(Revit.GeometryConversion)

# Enable Revit API
clr.AddReference('RevitAPI')
from Autodesk.Revit.DB import *

# Enable DocumentManager and TransactionManager
clr.AddReference('RevitServices')
from RevitServices.Persistence import DocumentManager
from RevitServices.Transactions import TransactionManager

# Enable ICollection List Translate
clr.AddReference("System")
import System.Collections.Generic
from System.Collections.Generic import List

def tolist(obj1):
	if hasattr(obj1,'__iter__'): return obj1
	else: return [obj1]
 
dataEnteringNode = IN
# Use UnwrapElement(IN[0]) When Translating From Dynamo to Revit
dim = tolist(UnwrapElement(IN[0]))

# Choose The Current Document
doc = DocumentManager.Instance.CurrentDBDocument
uidoc = DocumentManager.Instance.CurrentUIApplication.ActiveUIDocument
uiapp = DocumentManager.Instance.CurrentUIApplication
app = uiapp.Application

# Create Empty List
result = []
for e in dim:
	try:
		e.View.Scale
		result.append(e)
	except:
		pass

# Assign your output to the OUT variable.
OUT = result
# ----------------------------------------
dimensions_start_end_points = Custom[Dimensions Start End Points](VARDimensions=python_script)  # Dimensions Start End Points
isNull = Object.IsNull(obj=dimensions_start_end_points)
anyTrue = Custom[CW.List.AnyTrue](VARseq=isNull@L3)  # Returns true if any item in a list of booleans is true.
anyTrue_2 = Custom[CW.List.AnyTrue](VARseq=anyTrue@L2)
filterByBoolMask = List.FilterByBoolMask(list=python_script, mask=anyTrue_2)
filterByBoolMask_2 = List.FilterByBoolMask(list=dimensions_start_end_points, mask=anyTrue_2)
byBestFitThroughPoints = Line.ByBestFitThroughPoints(bestFitPoints=filterByBoolMask_2.out)
code_block_2 = CodeBlock { 0.5; }
pointAtParameter = Curve.PointAtParameter(curve=byBestFitThroughPoints, param=code_block_2)
firstItem = List.FirstItem(list=filterByBoolMask_2.out@@L2)
lastItem = List.LastItem(list=filterByBoolMask_2.out@@L2)
byTwoPoints = Vector.ByTwoPoints(start=firstItem, end=lastItem)
dimensions_leader_position = Custom[Dimensions Leader Position](VARDimensions=filterByBoolMask.out)  # Dimensions Leader Position
closestPointTo = Geometry.ClosestPointTo(geometry=byBestFitThroughPoints, other=dimensions_leader_position)
byTwoPoints_2 = Vector.ByTwoPoints(start=closestPointTo, end=dimensions_leader_position)
byOriginVectors = CoordinateSystem.ByOriginVectors(origin=pointAtParameter, xAxis=byTwoPoints, yAxis=byTwoPoints_2)
YAxis = CoordinateSystem.YAxis(coordinateSystem=byOriginVectors)
familyType = Custom[AL.FamilyInstance.FamilyType](VARFamilyInstance=filterByBoolMask.out)  # This node will return a Family Type of a given Family Instance. If no Family Type can be assigned to a Family then it will return Null.
python_script_2 = Python(IN[0]=familyType)
# ---------- python_script_2.python (57 lines) ----------
# Enable Python support and load DesignScript library
# IMPORTANT : ALL DYNAMO DESIGN SCRIPT NODES ARE AS (dg)
import clr
clr.AddReference('ProtoGeometry')
from Autodesk.DesignScript import Geometry as dg

# EXTENSION Enable ToDSType
clr.AddReference('RevitNodes')
import Revit
clr.ImportExtensions(Revit.Elements)

# Enable Revit Elements
from Revit.Elements import *

# EXTENSION Enable Geometry Conversion Methods
clr.ImportExtensions(Revit.GeometryConversion)

# Enable Revit API
clr.AddReference('RevitAPI')
from Autodesk.Revit.DB import *

# Enable DocumentManager and TransactionManager
clr.AddReference('RevitServices')
from RevitServices.Persistence import DocumentManager
from RevitServices.Transactions import TransactionManager

# Enable ICollection List Translate
clr.AddReference("System")
import System.Collections.Generic
from System.Collections.Generic import List

dataEnteringNode = IN
# Use UnwrapElement(IN[0]) When Translating From Dynamo to Revit
dim=UnwrapElement(IN[0])

# Choose The Current Document
doc = DocumentManager.Instance.CurrentDBDocument
uidoc = DocumentManager.Instance.CurrentUIApplication.ActiveUIDocument
uiapp = DocumentManager.Instance.CurrentUIApplication
app = uiapp.Application

if int(DocumentManager.Instance.CurrentUIApplication.Application.VersionNumber) < 2021:
	formatoptions = doc.GetUnits().GetFormatOptions(UnitType.UT_Length)
	dispunits = formatoptions.DisplayUnits
	factor = UnitUtils.ConvertFromInternalUnits(1,dispunits)
else:
	factor = UnitUtils.ConvertFromInternalUnits(1,doc.GetUnits().GetFormatOptions(SpecTypeId.Length).GetUnitTypeId())

# Create Empty List
result = []

for e in dim:
	size = e.get_Parameter(BuiltInParameter.TEXT_SIZE).AsDouble()*factor
	offset = e.get_Parameter(BuiltInParameter.TEXT_DIST_TO_LINE).AsDouble()*factor
	plus = size/2 + offset
	result.append(-1 * plus)
OUT = result
# ----------------------------------------
VARYJustification = Input(VARYJustification: var[]..[])
add = python_script_2 + VARYJustification
python_script_3 = Python(IN[0]=filterByBoolMask.out)
# ---------- python_script_3.python (52 lines) ----------
# Enable Python support and load DesignScript library
# IMPORTANT : ALL DYNAMO DESIGN SCRIPT NODES ARE AS (dg)
import clr
clr.AddReference('ProtoGeometry')
from Autodesk.DesignScript import Geometry as dg

# EXTENSION Enable ToDSType
clr.AddReference('RevitNodes')
import Revit
clr.ImportExtensions(Revit.Elements)

# Enable Revit Elements
from Revit.Elements import *

# EXTENSION Enable Geometry Conversion Methods
clr.ImportExtensions(Revit.GeometryConversion)

# Enable Revit API
clr.AddReference('RevitAPI')
from Autodesk.Revit.DB import *

# Enable DocumentManager and TransactionManager
clr.AddReference('RevitServices')
from RevitServices.Persistence import DocumentManager
from RevitServices.Transactions import TransactionManager

# Enable ICollection List Translate
clr.AddReference("System")
import System.Collections.Generic
from System.Collections.Generic import List

def tolist(obj1):
	if hasattr(obj1,'__iter__'): return obj1
	else: return [obj1]
 
dataEnteringNode = IN
# Use UnwrapElement(IN[0]) When Translating From Dynamo to Revit
dim = tolist(UnwrapElement(IN[0]))

# Choose The Current Document
doc = DocumentManager.Instance.CurrentDBDocument
uidoc = DocumentManager.Instance.CurrentUIApplication.ActiveUIDocument
uiapp = DocumentManager.Instance.CurrentUIApplication
app = uiapp.Application

# Create Empty List
result = []
for e in dim:
	result.append(e.View.Scale)

# Assign your output to the OUT variable.
OUT = result
# ----------------------------------------
mul = add * python_script_3
translate = Geometry.Translate(geometry=pointAtParameter, direction=YAxis, distance=mul, lacing=Longest)
XAxis = CoordinateSystem.XAxis(coordinateSystem=byOriginVectors)
VARXJustification = Input(VARXJustification: var[]..[])
mul_2 = VARXJustification * python_script_3
translate_2 = Geometry.Translate(geometry=translate, direction=XAxis, distance=mul_2, lacing=Longest)
python_script_4 = Python(IN[0]=filterByBoolMask.out, IN[1]=translate_2)
# ---------- python_script_4.python (71 lines) ----------
# Enable Python support and load DesignScript library
# IMPORTANT : ALL DYNAMO DESIGN SCRIPT NODES ARE AS (dg)
import clr
clr.AddReference('ProtoGeometry')
from Autodesk.DesignScript import Geometry as dg

# EXTENSION Enable ToDSType
clr.AddReference('RevitNodes')
import Revit
clr.ImportExtensions(Revit.Elements)

# Enable Revit Elements
from Revit.Elements import *

# EXTENSION Enable Geometry Conversion Methods
clr.ImportExtensions(Revit.GeometryConversion)

# Enable Revit API
clr.AddReference('RevitAPI')
from Autodesk.Revit.DB import *

# Enable DocumentManager and TransactionManager
clr.AddReference('RevitServices')
from RevitServices.Persistence import DocumentManager
from RevitServices.Transactions import TransactionManager

# Enable ICollection List Translate
clr.AddReference("System")
import System.Collections.Generic
from System.Collections.Generic import List

def tolist(obj1):
	if hasattr(obj1,'__iter__'): return obj1
	else: return [obj1]
	
dataEnteringNode = IN
# Use UnwrapElement(IN[0]) When Translating From Dynamo to Revit
dim = tolist(UnwrapElement(IN[0]))
position = tolist(UnwrapElement(IN[1]))

# Choose The Current Document
doc = DocumentManager.Instance.CurrentDBDocument
uidoc = DocumentManager.Instance.CurrentUIApplication.ActiveUIDocument
uiapp = DocumentManager.Instance.CurrentUIApplication
app = uiapp.Application

def SetDimensionTextPosition(dim,position):
	try:
		dim.TextPosition = position[0].ToXyz()
	except:
		counter = 0
		for seg in dim.Segments:
			seg.TextPosition = position[counter].ToXyz()
			counter += 1
	return "Done"
	
# Create Empty List
result = []
# Start a Transaction with Current Document (doc)
TransactionManager.Instance.EnsureInTransaction(doc)

counter = 0
for e in dim:
	result.append(SetDimensionTextPosition(e,position[counter]))
	counter += 1
	
# End the Transaction with Current Document ()
TransactionManager.Instance.TransactionTaskDone()
	
	
OUT = position
# ----------------------------------------
code_block_3 = CodeBlock { "Leader"; }
VARLeaderVisibility = Input(VARLeaderVisibility: var[]..[])
setParameterByName = Element.SetParameterByName(element=filterByBoolMask.out, parameterName=code_block_3, value=VARLeaderVisibility)
VARDimensions = Output(setParameterByName)
