# Dynamo custom node Nurbs Curves Re-Creation.dyf (Dynamo 2.1.0.7500)
# category: Synthesize.Automate.Lines
# Nurbs Curves Re-Creation

VARSmoothProfiles = Input(VARSmoothProfiles: var[]..[])
VARCurves = Input(VARCurves: var[]..[])
flatten = List.Flatten(list=VARCurves)
as_polycurve_bycurves = Custom[AS.[&] PolyCurve.ByCurves](VARcurves=flatten)  # Create polycurves from an unordered list of curves.
scopeIf = Custom[CW.ScopeIf+](VARtest=VARSmoothProfiles, VARtrue=as_polycurve_bycurves.VARpolyCurve, VARfalse=flatten)  # A (hopefully) more robust implementation of ScopeIf. Tests a single boolean and returns a value accordingly.
flatten_2 = List.Flatten(list=scopeIf)
code_block = CodeBlock { 0; 1; }
length = Curve.Length(curve=flatten_2)
VARControlPointsDistancing = Input(VARControlPointsDistancing: var[]..[])
div = length / VARControlPointsDistancing
ceiling = Math.Ceiling(number=div)
sequence = Sequence(start=code_block.out0, amount=ceiling, step=code_block.out1, lacing=Longest)
remapRange = Math.RemapRange(numbers=sequence, newMin=code_block.out0, newMax=code_block.out1)
pointAtParameter = Curve.PointAtParameter(curve=flatten_2, param=remapRange)
isClosed = Curve.IsClosed(curve=flatten_2)
filterByBoolMask = List.FilterByBoolMask(list=pointAtParameter, mask=isClosed)
code_block_2 = CodeBlock { 0; }
removeItemAtIndex = List.RemoveItemAtIndex(list=filterByBoolMask.in@L2, indices=code_block_2)
mergeByBoolMask = Custom[SP.List.MergeByBoolMask](VARIn=removeItemAtIndex, VAROut=filterByBoolMask.out, VARmask=isClosed)  # Merge two lists by a boolean mask list. The true count in the mask should be the same as the length of the true list and vice versa for the false list.
scopeIf_2 = Custom[CW.ScopeIf+](VARtest=VARSmoothProfiles, VARtrue=mergeByBoolMask, VARfalse=pointAtParameter)
VARSplinesDegree = Input(VARSplinesDegree: var[]..[])
VARSmoothlyCloseProfile = Input(VARSmoothlyCloseProfile: var[]..[])
byControlPoints = NurbsCurve.ByControlPoints(points=scopeIf_2, degree=VARSplinesDegree, closeCurve=VARSmoothlyCloseProfile)
string_from_object = FromObject(obj=flatten)
code_block_3 = CodeBlock { "NurbsCurve(Degree = 3)"; }
eq = string_from_object == code_block_3
filterByBoolMask_2 = List.FilterByBoolMask(list=byControlPoints, mask=eq)
filterByBoolMask_3 = List.FilterByBoolMask(list=flatten, mask=eq)
mergeByBoolMask_2 = Custom[SP.List.MergeByBoolMask](VARIn=filterByBoolMask_2.in, VAROut=filterByBoolMask_3.out, VARmask=eq)
scopeIf_3 = Custom[CW.ScopeIf+](VARtest=VARSmoothProfiles, VARtrue=byControlPoints, VARfalse=mergeByBoolMask_2)
VARNurbsCurve = Output(scopeIf_3)
