# Dynamo custom node Override All Elements in All of the given Views.dyf (Dynamo 2.1.0.7500)
# category: Synthesize.Automate.Clash Detection
# Override All Elements in All of the given Views

VARViews = Input(VARViews: var[]..[])
VARElements = Input(VARElements: var[]..[])
flatten = List.Flatten(list=VARElements)
turnIntoList = Custom[CW.TurnIntoList](VARunknownItem=flatten)  # Turns an element (or a nested list) into a flat list
id = Element.Id(element=turnIntoList)
VAROverrideCutFillColors = Input(VAROverrideCutFillColors: var[]..[])
VARForceCutFillColorWithBlack = Input(VARForceCutFillColorWithBlack: var[]..[])
code_block = CodeBlock { 255; 0; }
byARGB = Color.ByARGB(a=code_block.out0, r=code_block.out1, g=code_block.out1, b=code_block.out1)
VARdynamoColor = Input(VARdynamoColor: var[]..[])
create = List.Create(item0=turnIntoList)
count = List.Count(list=create)
cycle = List.Cycle(list=VARdynamoColor, amount=count)
alpha = Color.Alpha(color=cycle)
red = Color.Red(color=cycle)
green = Color.Green(color=cycle)
blue = Color.Blue(color=cycle)
byARGB_2 = Color.ByARGB(a=alpha, r=red, g=green, b=blue)
count_2 = List.Count(list=byARGB_2)
cycle_2 = List.Cycle(list=byARGB, amount=count_2)
clean = Custom[RH.Output.Clean](VARinput=byARGB_2)  # This will return a single value or list from one input.
scopeIf = Custom[CW.ScopeIf+](VARtest=VARForceCutFillColorWithBlack, VARtrue=cycle_2, VARfalse=clean)  # A (hopefully) more robust implementation of ScopeIf. Tests a single boolean and returns a value accordingly.
scopeIf_2 = Custom[CW.ScopeIf+](VARtest=VAROverrideCutFillColors, VARtrue=scopeIf, VARfalse=clean)
cut_fill_color = Custom[Cut Fill Color](VAR=scopeIf_2@L1)
clean_2 = Custom[RH.Output.Clean](VARinput=cut_fill_color)
VAROverrideProjectionFillColors = Input(VAROverrideProjectionFillColors: var[]..[])
code_block_2 = CodeBlock { null; }
scopeIf_3 = Custom[CW.ScopeIf+](VARtest=VAROverrideProjectionFillColors, VARtrue=clean, VARfalse=code_block_2)
projection_fill_color = Custom[Projection Fill Color](VAR=scopeIf_3@L1)
clean_3 = Custom[RH.Output.Clean](VARinput=projection_fill_color)
turnIntoList_2 = Custom[CW.TurnIntoList](VARunknownItem=clean_3)
code_block_3 = CodeBlock { -1; }
replaceNull = Custom[CW.List.ReplaceNull](VARseq=turnIntoList_2, VARreplacement=code_block_3)  # Replaces all null values within a given list with a substitute
clean_4 = Custom[RH.Output.Clean](VARinput=replaceNull)
VAROverrideCutLinesColor = Input(VAROverrideCutLinesColor: var[]..[])
code_block_4 = CodeBlock { null; }
scopeIf_4 = Custom[CW.ScopeIf+](VARtest=VAROverrideCutLinesColor, VARtrue=clean, VARfalse=code_block_4)
cut_line_color = Custom[Cut Line Color](VAR=scopeIf_4@L1)
clean_5 = Custom[RH.Output.Clean](VARinput=cut_line_color)
VAROverrideProjectionLinesColor = Input(VAROverrideProjectionLinesColor: var[]..[])
scopeIf_5 = Custom[CW.ScopeIf+](VARtest=VAROverrideProjectionLinesColor, VARtrue=clean, VARfalse=code_block_4)
projection_line_color = Custom[Projection Line Color](VAR=scopeIf_5@L1)
clean_6 = Custom[RH.Output.Clean](VARinput=projection_line_color)
turnIntoList_3 = Custom[CW.TurnIntoList](VARunknownItem=clean_6)
code_block_5 = CodeBlock { -1; }
replaceNull_2 = Custom[CW.List.ReplaceNull](VARseq=turnIntoList_3, VARreplacement=code_block_5)
clean_7 = Custom[RH.Output.Clean](VARinput=replaceNull_2)
VARCutPattern = Input(VARCutPattern: var[]..[])
id_2 = Element.Id(element=VARCutPattern)
cut_pattern = Python(IN[0]=id_2)
# ---------- cut_pattern.python (20 lines) ----------
import clr
clr.AddReference('ProtoGeometry')
from Autodesk.DesignScript.Geometry import *

clr.AddReference('RevitAPI')
from Autodesk.Revit.DB import *

clr.AddReference("RevitNodes")
import Revit
clr.ImportExtensions(Revit.Elements)

clr.AddReference("RevitServices")
import RevitServices
from RevitServices.Persistence import DocumentManager
from RevitServices.Transactions import TransactionManager

doc = DocumentManager.Instance.CurrentDBDocument
integerID = IN[0]
Result = ElementId(integerID)
OUT = Result
# ----------------------------------------
code_block_6 = CodeBlock { null; }
scopeIf_6 = Custom[CW.ScopeIf+](VARtest=VAROverrideCutFillColors, VARtrue=cut_pattern, VARfalse=code_block_6)
turnIntoList_4 = Custom[CW.TurnIntoList](VARunknownItem=scopeIf_6)
code_block_7 = CodeBlock { -1; }
replaceNull_3 = Custom[CW.List.ReplaceNull](VARseq=turnIntoList_4, VARreplacement=code_block_7)
clean_8 = Custom[RH.Output.Clean](VARinput=replaceNull_3)
VARProjectionPattern = Input(VARProjectionPattern: var[]..[])
id_3 = Element.Id(element=VARProjectionPattern)
fill_pattern = Python(IN[0]=id_3)  # same code as cut_pattern
scopeIf_7 = Custom[CW.ScopeIf+](VARtest=VAROverrideProjectionFillColors, VARtrue=fill_pattern, VARfalse=code_block_2)
turnIntoList_5 = Custom[CW.TurnIntoList](VARunknownItem=scopeIf_7)
code_block_8 = CodeBlock { -1; }
replaceNull_4 = Custom[CW.List.ReplaceNull](VARseq=turnIntoList_5, VARreplacement=code_block_8)
clean_9 = Custom[RH.Output.Clean](VARinput=replaceNull_4)
code_block_9 = CodeBlock { -1; }
VARTransparancy = Input(VARTransparancy: var[]..[])
transparency = List.Cycle(list=VARTransparancy, amount=count)
clean_10 = Custom[RH.Output.Clean](VARinput=transparency)
VARHalfTone = Input(VARHalfTone: var[]..[])
python_script = Python(IN[0]=clean_2, IN[1]=clean_4, IN[2]=clean_5, IN[3]=clean_7, IN[4]=clean_8, IN[5]=clean_9, IN[6]=code_block_9, IN[7]=code_block_9, IN[8]=clean_10, IN[9]=VARHalfTone)
# ---------- python_script.python (72 lines) ----------
import clr
clr.AddReference('ProtoGeometry')
from Autodesk.DesignScript.Geometry import *

clr.AddReference('RevitAPI')
from Autodesk.Revit.DB import *

CutFillColor = IN[0]
ProjectionFillColor = IN[1]
CutLineColor = IN[2]
ProjectionLineColor = IN[3]
CutFillPatternID = IN[4]
ProjectionFillPatternID = IN[5]
CutLinePatternID = IN[6]
ProjectionLinePatternID = IN[7]
SurfaceTransparency = IN[8]
Halftone = IN[9]


settings = OverrideGraphicSettings()

if Halftone == -1 or Halftone == None:
	pass
else:
	settings.SetHalftone(Halftone)

if CutFillColor == -1 or CutFillColor == None:
	pass
else:
	settings.SetCutForegroundPatternColor(CutFillColor)

if CutFillPatternID == -1 or CutFillPatternID == None:
	pass
else:
	settings.SetCutForegroundPatternId(CutFillPatternID)

if CutFillPatternID == -1 or CutFillPatternID == None:
	pass
else:
	settings.SetCutLineColor(CutLineColor)

if CutFillPatternID == -1 or CutFillPatternID == None:
	pass
else:
	settings.SetCutLinePatternId(CutLinePatternID)

if ProjectionFillColor == -1 or ProjectionFillColor == None:
	pass
else:
	settings.SetSurfaceForegroundPatternColor(ProjectionFillColor)

if ProjectionFillPatternID == -1 or ProjectionFillPatternID == None:
	pass
else:
	settings.SetSurfaceForegroundPatternId(ProjectionFillPatternID)

if ProjectionLineColor == -1 or ProjectionLineColor == None:
	pass
else:
	settings.SetProjectionLineColor(ProjectionLineColor)

if ProjectionLinePatternID == -1 or ProjectionLinePatternID == None:
	pass
else:
	settings.SetProjectionLinePatternId(ProjectionLinePatternID)

if SurfaceTransparency == -1 or SurfaceTransparency == None:
	pass
else:
	settings.SetSurfaceTransparency(SurfaceTransparency)

OUT = settings
# ----------------------------------------
turnIntoList_6 = Custom[CW.TurnIntoList](VARunknownItem=python_script)
python_script_2 = Python(IN[0]=VARViews, IN[1]=id, IN[2]=turnIntoList_6)
# ---------- python_script_2.python (38 lines) ----------
import clr
clr.AddReference('ProtoGeometry')
from Autodesk.DesignScript.Geometry import *

clr.AddReference('RevitAPI')
from Autodesk.Revit.DB import *

clr.AddReference("RevitNodes")
import Revit
clr.ImportExtensions(Revit.Elements)

clr.AddReference("RevitServices")
import RevitServices
from RevitServices.Persistence import DocumentManager
from RevitServices.Transactions import TransactionManager

doc = DocumentManager.Instance.CurrentDBDocument

view = UnwrapElement(IN[0])
elementinput = UnwrapElement(IN[1])
element = []
for every in elementinput:
	id = ElementId(every)
	element.append(id)
override = IN[2]
result = []
count = 0

TransactionManager.Instance.EnsureInTransaction(doc)
for each in view:
	for i in element:
		each.SetElementOverrides(i, override[count])
		result.append("Success")

TransactionManager.Instance.TransactionTaskDone()


OUT = result
# ----------------------------------------
VARResult = Output(python_script_2)
