# Dynamo custom node Override Material Assets.dyf (Dynamo 2.1.0.7500)
# category: Synthesize.Automate.Material
# Override Material Assets

mod_get_views_by_type = Custom[MOD.Get Views By Type]()  # Get all views in the project classified by type
code_block = CodeBlock { "View Name"; }
getParameterValueByName = Element.GetParameterValueByName(element=mod_get_views_by_type.VARdraftingViews, parameterName=code_block)
VARDraftingViewName = Input(VARDraftingViewName: var[]..[])
eq = getParameterValueByName == VARDraftingViewName
categories = Categories("OST_Materials")
all_elements_of_category = ElementsOfCategory(Category=categories)
name = Material.Name(material=all_elements_of_category)
code_block_2 = CodeBlock { "DynamoError"; }
eq_2 = name == code_block_2
filterByBoolMask = List.FilterByBoolMask(list=all_elements_of_category, mask=eq_2)
VARMaterialToReadItsASSETForOverriding = Input(VARMaterialToReadItsASSETForOverriding: string)
toLower = String.ToLower(str=VARMaterialToReadItsASSETForOverriding)
name_2 = Material.Name(material=filterByBoolMask.out)
toLower_2 = String.ToLower(str=name_2)
eq_3 = toLower == toLower_2
filterByBoolMask_2 = List.FilterByBoolMask(list=filterByBoolMask.out, mask=eq_3)
firstItem = List.FirstItem(list=filterByBoolMask_2.in)
isNull = Object.IsNull(obj=firstItem)
scopeIf = Custom[CW.ScopeIf+](VARtest=isNull, VARtrue=firstItem, VARfalse=VARDraftingViewName)  # A (hopefully) more robust implementation of ScopeIf. Tests a single boolean and returns a value accordingly.

# group: View Exists Condition
anyTrue = Custom[CW.List.AnyTrue](VARseq=eq)  # Returns true if any item in a list of booleans is true.
empty = List.Empty()
scopeIf_2 = Custom[CW.ScopeIf+](VARtest=anyTrue, VARtrue=empty, VARfalse=scopeIf)

code_block_3 = CodeBlock { "Material Not Found"; null; }
scopeIf_3 = Custom[CW.ScopeIf+](VARtest=isNull, VARtrue=code_block_3.out0, VARfalse=code_block_3.out1)
alert_popup = Custom[Alert Popup](VARMessage=scopeIf_3)  # Popup a message dialog in Revit
VARExtraMaterialsToExcludeFromOverride = Input(VARExtraMaterialsToExcludeFromOverride: string)
VARSeparator = Input(VARSeparator: var[]..[])
split = String.Split(str=VARExtraMaterialsToExcludeFromOverride, separator0=VARSeparator)
trimWhitespace = String.TrimWhitespace(str=split)
VARAutoExcludeTransparentMaterials = Input(VARAutoExcludeTransparentMaterials: var[]..[])
empty_2 = List.Empty()
scopeIf_4 = Custom[CW.ScopeIf+](VARtest=VARAutoExcludeTransparentMaterials, VARtrue=all_elements_of_category, VARfalse=empty_2)
filter_transparent_materials = Custom[Filter Transparent Materials](VARMaterials=scopeIf_4)  # Filter Transparent Materials
name_3 = Material.Name(material=filter_transparent_materials)
create = List.Create(item0=trimWhitespace, item1=name_3)
code_block_4 = CodeBlock { false; }
clean = List.Clean(list=create, preserveIndices=code_block_4)
flatten = List.Flatten(list=clean)
uniqueItems = List.UniqueItems(list=flatten)
toLower_3 = String.ToLower(str=uniqueItems)
contains = List.Contains(list=toLower_2@L1, item=toLower_3, lacing=CrossProduct)
anyTrue_2 = Custom[CW.List.AnyTrue](VARseq=contains)
filterByBoolMask_3 = List.FilterByBoolMask(list=filterByBoolMask.out, mask=anyTrue_2)
filterByBoolMask_4 = List.FilterByBoolMask(list=mod_get_views_by_type.VARdraftingViews, mask=eq)
python_script = Python(IN[0]=filterByBoolMask_4.in)
# ---------- python_script.python (41 lines) ----------
# Enable Python support and load DesignScript library
# IMPORTANT : ALL DYNAMO DESIGN SCRIPT NODES ARE AS (dg)
import clr
clr.AddReference('ProtoGeometry')
from Autodesk.DesignScript import Geometry as dg

# EXTENSION Enable ToDSType
clr.AddReference('RevitNodes')
import Revit
clr.ImportExtensions(Revit.Elements)

# Enable Revit Elements
from Revit.Elements import *

# EXTENSION Enable Geometry Conversion Methods
clr.ImportExtensions(Revit.GeometryConversion)

# Enable Revit API
clr.AddReference('RevitAPI')
from Autodesk.Revit.DB import *

# Enable DocumentManager and TransactionManager
clr.AddReference('RevitServices')
from RevitServices.Persistence import DocumentManager
from RevitServices.Transactions import TransactionManager

# Enable ICollection List Translate
clr.AddReference("System")
import System.Collections.Generic
from System.Collections.Generic import List

view = UnwrapElement(IN[0])
doc = DocumentManager.Instance.CurrentDBDocument

try:
	collector = FilteredElementCollector(doc,view[0].Id).ToElements();
except:
	collector = []

#Assign your output to the OUT variable.
OUT = collector
# ----------------------------------------
code_block_5 = CodeBlock { "TextNote"; }
byClassName = Custom[SP.Filter.ByClassName](VARobject=python_script, VARclassName=code_block_5)  # Filters a list of objects by the object's class name. Note that Dynamo elements belong to different classes than their Revit counterparts. Use the Object.Class node to check an object's class.
code_block_6 = CodeBlock { ","; "-"; }
text = TextNote.Text(textNote=byClassName.VARin)
code_block_7 = CodeBlock { ","; "-"; }
split_2 = String.Split(str=text, separator0=code_block_7.out1)
split_3 = String.Split(str=split_2, separator0=code_block_7.out0)

# group: Existed Data
flatten_2 = List.Flatten(list=split_3@L2)

join = List.Join()  # unwired: list0, list1
id = Element.Id(element=filterByBoolMask_3.out)
materialAssetElement = Custom[AL.Material.MaterialAssetElement](VARMaterial=filterByBoolMask_3.out)  # This node retrieves a Material Asset Element from Material. If such is not defined it will return an Invalid Element Id (-1)
id_2 = Element.Id()  # unwired: element
map = List.Map(list=materialAssetElement, f_x=id_2)
string_from_object = FromObject(obj=map)
combine = List.Combine(comb=join, list1=id, list2=string_from_object)
string_from_object_2 = FromObject(obj=combine)
create_2 = List.Create(item0=flatten_2, item1=string_from_object_2)
code_block_8 = CodeBlock { false; }
clean_2 = List.Clean(list=create_2, preserveIndices=code_block_8)
flatten_3 = List.Flatten(list=clean_2@L2)
uniqueItems_2 = List.UniqueItems(list=flatten_3)
code_block_9 = CodeBlock { false; }
clean_3 = List.Clean(list=uniqueItems_2, preserveIndices=code_block_9)
firstItem_2 = List.FirstItem(list=clean_3@L2)
al_duplicate_item_indices = Custom[AL.Duplicate Item Indices](VARList=firstItem_2)  # Searches an input list for duplicate entries and lists their index numbers. Couple with Get From List to delete duplicates from a list.
getItemAtIndex = List.GetItemAtIndex(list=clean_3, index=al_duplicate_item_indices.VARUniqueIndices)
code_block_10 = CodeBlock { false; }
clean_4 = List.Clean(list=getItemAtIndex, preserveIndices=code_block_10)
join_2 = String.Join(separator=code_block_6.out0, string0=clean_4)
join_3 = String.Join(separator=code_block_6.out1, string0=join_2)
flatten_4 = List.Flatten(list=join_3)
setText = TextNote.SetText(textNote=byClassName.VARin, value=flatten_4)
passthrough = Custom[CW.Passthrough](VARpassThrough=filterByBoolMask_3.out, VARwaitFor=setText)  # Forces a sequential order of execution. The node wired into the output of the Passthrough node will be executed *after* the node wired into the waitFor input (e.g. important for some Revit operations). The value of the passThrough input will be passed on to the node wired into the output port of the Passthrough node.
setMaterialAssetByMaterial = Custom[AL.Material.SetMaterialAssetByMaterial](VARTargetMaterial=passthrough, VARSourceMaterial=firstItem)  # This node will copy a material asset element from source Material to a list of target materials. It esentially makes all materials inherit its Rendering Appearance. Useful for "clay" renderings.
code_block_11 = CodeBlock { false; }
clean_5 = List.Clean(list=setMaterialAssetByMaterial, preserveIndices=code_block_11)
flatten_5 = List.Flatten(list=clean_5)
VARPrefix = Input(VARPrefix: var[]..[])
python_script_2 = Python(IN[0]=flatten_5, IN[1]=VARPrefix, IN[2]=firstItem)
# ---------- python_script_2.python (71 lines) ----------
# Enable Python support and load DesignScript library
# IMPORTANT : ALL DYNAMO DESIGN SCRIPT NODES ARE AS (dg)
import clr
clr.AddReference('ProtoGeometry')
from Autodesk.DesignScript import Geometry as dg

# EXTENSION Enable ToDSType
clr.AddReference('RevitNodes')
import Revit
clr.ImportExtensions(Revit.Elements)

# Enable Revit Elements
from Revit.Elements import *

# EXTENSION Enable Geometry Conversion Methods
clr.ImportExtensions(Revit.GeometryConversion)

# Enable Revit API
clr.AddReference('RevitAPI')
from Autodesk.Revit.DB import *

# Enable DocumentManager and TransactionManager
clr.AddReference('RevitServices')
from RevitServices.Persistence import DocumentManager
from RevitServices.Transactions import TransactionManager

# Enable ICollection List Translate
clr.AddReference("System")
import System.Collections.Generic
from System.Collections.Generic import List

def tolist(obj1):
	if hasattr(obj1,'__iter__'): return obj1
	else: return [obj1]

dataEnteringNode = IN
# Use UnwrapElement(IN[0]) When Translating From Dynamo to Revit
materials = UnwrapElement(tolist(IN[0]))
prefix = IN[1]
forbidden = UnwrapElement(IN[2])
# Choose The Current Document
doc = DocumentManager.Instance.CurrentDBDocument
uidoc = DocumentManager.Instance.CurrentUIApplication.ActiveUIDocument
uiapp = DocumentManager.Instance.CurrentUIApplication
app = uiapp.Application

# Create Empty List
result = []

# Start a Transaction with Current Document (doc)
TransactionManager.Instance.EnsureInTransaction(doc)

if len(prefix) != 0:
	for e in materials:
		if e == forbidden or e.Name.startswith(prefix):
			continue
		try:
			currentname = e.Name
			special = ["\\",":","{","}","[","]","|",";","<",">","?","`","~"]
			for s in special:
				currentname = currentname.replace(s,"")
			newname = prefix + currentname
			e.Name = newname
		except:
			pass

# End the Transaction with Current Document ()
TransactionManager.Instance.TransactionTaskDone()

# Assign your output to the OUT variable.
OUT = "Done"
# ----------------------------------------
VARMaterials = Output(python_script_2)
join_4 = String.Join(separator=code_block_7.out0, string0=string_from_object_2)
join_5 = String.Join(separator=code_block_7.out1, string0=join_4)

# group: New Data
flatten_6 = List.Flatten(list=join_5)

# group: New View If No Exists
byName = DraftingView.ByName(name=scopeIf_2)
byCoordinates = Point.ByCoordinates()
code_block_12 = CodeBlock { "Align Center"; }
byLocation = TextNote.ByLocation(view=byName, location=byCoordinates, text=flatten_6, alignment=code_block_12)

VARDraftingView = Output(byName)
VARTextNote = Output(byLocation)
