# Dynamo custom node Parameters Selector.dyf (Dynamo 2.1.0.7500)
# category: Synthesize.Automate.Parameter
# Parameters Selector

VARParameterNames = Input(VARParameterNames: var[]..[])
code_block = CodeBlock { "*"; ""; }
contains = String.Contains(str=VARParameterNames, searchFor=code_block.out0)
VARIsTypeParam = Input(VARIsTypeParam: bool = false)
VARElements = Input(VARElements: var[]..[])
empty = List.Empty()
scopeIf = Custom[CW.ScopeIf+](VARtest=VARIsTypeParam, VARtrue=VARElements, VARfalse=empty)  # A (hopefully) more robust implementation of ScopeIf. Tests a single boolean and returns a value accordingly.
familyType = Custom[AL.FamilyInstance.FamilyType](VARFamilyInstance=scopeIf)  # This node will return a Family Type of a given Family Instance. If no Family Type can be assigned to a Family then it will return Null.
scopeIf_2 = Custom[CW.ScopeIf+](VARtest=VARIsTypeParam, VARtrue=familyType, VARfalse=VARElements)
isNull = Object.IsNull(obj=scopeIf_2)
filterByBoolMask = List.FilterByBoolMask(list=scopeIf_2, mask=isNull)
parameters = Element.Parameters(element=filterByBoolMask.out)
name = Parameter.Name(parameter=parameters)
toLower = String.ToLower(str=name)
empty_2 = List.Empty()
scopeIf_3 = Custom[CW.ScopeIf+](VARtest=contains, VARtrue=VARParameterNames, VARfalse=empty_2)
replace = String.Replace(str=scopeIf_3, searchFor=code_block.out0, replaceWith=code_block.out1)
toLower_2 = String.ToLower(str=replace)
startsWith = String.StartsWith(str=toLower, searchFor=toLower_2)
filterByBoolMask_2 = List.FilterByBoolMask(list=name, mask=startsWith)
flatten = List.Flatten(list=filterByBoolMask_2.in)
uniqueItems = List.UniqueItems(list=flatten)
flatten_2 = List.Flatten(list=name)
scopeIf_4 = Custom[CW.ScopeIf+](VARtest=contains, VARtrue=empty_2, VARfalse=VARParameterNames)
VARSeparationSymbol = Input(VARSeparationSymbol: var[]..[])
split = String.Split(str=scopeIf_4, separator0=VARSeparationSymbol)
toLower_3 = String.ToLower(str=split)
count = List.Count(list=toLower_3)
ofRepeatedItem = List.OfRepeatedItem(item=flatten_2, amount=count)
flatten_3 = List.Flatten(list=toLower)
eq = flatten_3 == toLower_3@L1
filterByBoolMask_3 = List.FilterByBoolMask(list=ofRepeatedItem, mask=eq)
uniqueItems_2 = List.UniqueItems(list=filterByBoolMask_3.in@L2)
flatten_4 = List.Flatten(list=uniqueItems_2)
scopeIf_5 = Custom[CW.ScopeIf+](VARtest=contains, VARtrue=uniqueItems, VARfalse=flatten_4)
VARParameterNames_2 = Output(scopeIf_5)  # "VARParameterNames"
