# Dynamo custom node Place Families By Upper Smart Points.dyf (Dynamo 2.1.0.7500)
# category: Synthesize.Automate.Family
# Place Families By Upper Smart Points

VARFamilyType = Input(VARFamilyType: var[]..[])
VARAllRooms = Input(VARAllRooms: var[]..[])
VARYesNoSyncParameter = Input(VARYesNoSyncParameter: var[]..[])
VARCurvesDivideTollerance = Input(VARCurvesDivideTollerance: var[]..[])
VAROffsetFromWalls = Input(VAROffsetFromWalls: var[]..[])
VARUDistance = Input(VARUDistance: var[]..[])
VARVDistance = Input(VARVDistance: var[]..[])
smart_points_by_rooms = Custom[Smart Points By Rooms](VARAllRooms=VARAllRooms, VARYesNoSyncParameter=VARYesNoSyncParameter, VARCurvesDivideTollerance=VARCurvesDivideTollerance, VAROffsetFromWalls=VAROffsetFromWalls, VARUDistance=VARUDistance, VARVDistance=VARVDistance)  # Smart Lights By Rooms
normal = Plane.Normal(plane=smart_points_by_rooms.VARPlanes)
X = Vector.X(vector=normal)
Y = Vector.Y(vector=normal)
Z = Vector.Z(vector=normal)
abs = Math.Abs(number=Z)
code_block = CodeBlock { -1; }
mul = abs * code_block
byCoordinates = Vector.ByCoordinates(x=X, y=Y, z=mul)
XAxis = Plane.XAxis(plane=smart_points_by_rooms.VARPlanes)
byOriginNormalXAxis = Plane.ByOriginNormalXAxis(origin=smart_points_by_rooms.VARPoints, normal=byCoordinates, xAxis=XAxis)
byWidthLength = Rectangle.ByWidthLength(plane=byOriginNormalXAxis)
byPatch = Surface.ByPatch(closedCurve=byWidthLength)
flatten = List.Flatten(list=byPatch)
categories = Categories("OST_GenericModel")
python_script = Python(IN[0]=flatten, IN[1]=categories)
# ---------- python_script.python (70 lines) ----------
# Enable Python support and load DesignScript library
# IMPORTANT : ALL DYNAMO DESIGN SCRIPT NODES ARE AS (dg)
import sys
sys.path.append(r'C:\Program Files (x86)\IronPython 2.7\DLLs')
sys.path.append(r'C:\Program Files (x86)\IronPython 2.7\Lib')
import random

import clr
clr.AddReference('ProtoGeometry')
from Autodesk.DesignScript import Geometry as dg

# EXTENSION Enable ToDSType
clr.AddReference('RevitNodes')
import Revit
clr.ImportExtensions(Revit.Elements)

# Enable Revit Elements
from Revit.Elements import *

# EXTENSION Enable Geometry Conversion Methods
clr.ImportExtensions(Revit.GeometryConversion)

# Enable Revit API
clr.AddReference('RevitAPI')
from Autodesk.Revit.DB import *

# Enable DocumentManager and TransactionManager
clr.AddReference('RevitServices')
from RevitServices.Persistence import DocumentManager
from RevitServices.Transactions import TransactionManager

# Enable ICollection List Translate
clr.AddReference("System")
import System.Collections.Generic
from System.Collections.Generic import List

def tolist(obj1):
	if hasattr(obj1,'__iter__'): return obj1
	else: return [obj1]

dataEnteringNode = IN
# Use UnwrapElement(IN[0]) When Translating From Dynamo to Revit
surfs = UnwrapElement(tolist(IN[0]))
cat = IN[1]

# Choose The Current Document
doc = DocumentManager.Instance.CurrentDBDocument
uidoc = DocumentManager.Instance.CurrentUIApplication.ActiveUIDocument
uiapp = DocumentManager.Instance.CurrentUIApplication
app = uiapp.Application

# Create Empty List
result = []
dshapes = []
# Start a Transaction with Current Document (doc)
TransactionManager.Instance.EnsureInTransaction(doc)

nums = len(surfs)
for e in surfs:
	name = "DirectShape" + str(random.randint(10, 100000000000))
	dshape = Revit.Elements.DirectShape.ByGeometry(e,cat,Revit.Elements.DirectShape.DynamoPreviewMaterial,name)
	dface = dshape.Faces
	result.append(dface)
	dshapes.append(dshape)

# End the Transaction with Current Document ()
TransactionManager.Instance.TransactionTaskDone()

# Assign your output to the OUT variable.
OUT = result,dshapes
# ----------------------------------------
code_block_2 = CodeBlock(a=python_script) { a[0]; a[1]; }
flatten_2 = List.Flatten(list=code_block_2.out0)
flatten_3 = List.Flatten(list=smart_points_by_rooms.VARPoints)
XAxis_2 = Plane.XAxis(plane=byOriginNormalXAxis)
flatten_4 = List.Flatten(list=XAxis_2)
byFace = FamilyInstance.ByFace(familyType=VARFamilyType, face=flatten_2, location=flatten_3, referenceDirection=flatten_4)
VARFamilyInstances = Output(byFace)
python_script_2 = Python(IN[0]=byFace, IN[1]=code_block_2.out1)
# ---------- python_script_2.python (57 lines) ----------
# Enable Python support and load DesignScript library
# IMPORTANT : ALL DYNAMO DESIGN SCRIPT NODES ARE AS (dg)
import clr
clr.AddReference('ProtoGeometry')
from Autodesk.DesignScript import Geometry as dg

# EXTENSION Enable ToDSType
clr.AddReference('RevitNodes')
import Revit
clr.ImportExtensions(Revit.Elements)

# Enable Revit Elements
from Revit.Elements import *

# EXTENSION Enable Geometry Conversion Methods
clr.ImportExtensions(Revit.GeometryConversion)

# Enable Revit API
clr.AddReference('RevitAPI')
from Autodesk.Revit.DB import *

# Enable DocumentManager and TransactionManager
clr.AddReference('RevitServices')
from RevitServices.Persistence import DocumentManager
from RevitServices.Transactions import TransactionManager

# Enable ICollection List Translate
clr.AddReference("System")
import System.Collections.Generic
from System.Collections.Generic import List

def tolist(obj1):
	if hasattr(obj1,'__iter__'): return obj1
	else: return [obj1]

dataEnteringNode = IN
# Use UnwrapElement(IN[0]) When Translating From Dynamo to Revit
wait = UnwrapElement(tolist(IN[0]))
dshapes = IN[1]

# Choose The Current Document
doc = DocumentManager.Instance.CurrentDBDocument
uidoc = DocumentManager.Instance.CurrentUIApplication.ActiveUIDocument
uiapp = DocumentManager.Instance.CurrentUIApplication
app = uiapp.Application


# Start a Transaction with Current Document (doc)
TransactionManager.Instance.EnsureInTransaction(doc)

for e in dshapes:
	doc.Delete(UnwrapElement(e).Id)
# End the Transaction with Current Document ()
TransactionManager.Instance.TransactionTaskDone()

# Assign your output to the OUT variable.
OUT = "Done"
# ----------------------------------------
