# Dynamo custom node Planes and  Curve of Divided Path.dyf "Planes and Curve of Divided Path" (Dynamo 2.1.0.7500)
# category: Synthesize.Automate.Lines
# Planes and  Curve of Divided Path

VARDividedPaths = Input(VARDividedPaths: var[]..[])
VARPrecisionInFeet = Input(VARPrecisionInFeet: double = 1)
python_script = Python(IN[0]=VARDividedPaths, IN[1]=VARPrecisionInFeet)
# ---------- python_script.python (136 lines) ----------
# Enable Python support and load DesignScript library
# IMPORTANT : ALL DYNAMO DESIGN SCRIPT NODES ARE AS (dg)
import clr
clr.AddReference('ProtoGeometry')
from Autodesk.DesignScript import Geometry as dg

# EXTENSION Enable ToDSType
clr.AddReference('RevitNodes')
import Revit
clr.ImportExtensions(Revit.Elements)

# Enable Revit Elements
from Revit.Elements import *

# EXTENSION Enable Geometry Conversion Methods
clr.ImportExtensions(Revit.GeometryConversion)

# Enable Revit API
clr.AddReference('RevitAPI')
from Autodesk.Revit.DB import *

# Enable DocumentManager and TransactionManager
clr.AddReference('RevitServices')
from RevitServices.Persistence import DocumentManager
from RevitServices.Transactions import TransactionManager

# Enable ICollection List Translate
clr.AddReference("System")
import System.Collections.Generic
from System.Collections.Generic import List

def tolist(obj1):
	if hasattr(obj1,'__iter__'): return obj1
	else: return [obj1]

def flatten(x):
    result = []
    for el in x:
        if hasattr(el, "__iter__") and not isinstance(el, basestring):
            result.extend(flatten(el))
        else:
            result.append(el)
    return result

divpathlist = UnwrapElement(flatten(tolist(IN[0])))
precision = IN[1]

# Choose The Current Document
doc = DocumentManager.Instance.CurrentDBDocument
uidoc = DocumentManager.Instance.CurrentUIApplication.ActiveUIDocument
uiapp = DocumentManager.Instance.CurrentUIApplication
app = uiapp.Application

opt1 = Options()
opt1.ComputeReferences = True
opt1.IncludeNonVisibleObjects=True

if int(DocumentManager.Instance.CurrentUIApplication.Application.VersionNumber) < 2021:
	unit_type = UnitType.UT_Length
	formatoptions = doc.GetUnits().GetFormatOptions(unit_type)
	dispunits = formatoptions.DisplayUnits
	precisionconv = UnitUtils.ConvertFromInternalUnits(precision,dispunits)
else:
	precisionconv = UnitUtils.ConvertFromInternalUnits(precision,doc.GetUnits().GetFormatOptions(SpecTypeId.Length).GetUnitTypeId())

def normalize(length,nostartend = False,twominonly = False):
	if length != None:
		if length <= 3 and twominonly == False:
			length = 4
		elif length <= 3 and twominonly == True:
			if length < 2:
				length = 2
		if nostartend:
			length += 2
		a = range(0,int(length))
		points = []
		amin, amax = min(a), max(a)
		item = []
		for val in a:
			item.append(float(val-amin) / float(amax-amin))
	else:
		item = [None]
	if nostartend == True:
		item.pop(0)
		item.pop(-1)
	return item

def divOP(divpath):
	if isinstance(divpath,DividedPath):
		result = []
		points = []
		divpoints = []
		planes = []
		stuff = divpath.GetDependentElements(None)
		for s in stuff:
			elem = doc.GetElement(s)
			if isinstance(elem,Path3d):
				tmpout = []
				wanted = elem.AllCurveLoops[0]
				for conv in wanted:
					if conv.ToString() != "Autodesk.Revit.DB.CylindricalHelix":
						tmpout.append(conv.ToProtoType())
					else:
						tess = conv.Tessellate()
						tmp = []
						for s in tess:
							tmp.append(s.ToPoint())
						tmpout.append(dg.NurbsCurve.ByPoints(tmp))
				result = dg.PolyCurve.ByJoinedCurves(tmpout)
				if int(DocumentManager.Instance.CurrentUIApplication.Application.VersionNumber) < 2021:
					nums = normalize(UnitUtils.ConvertToInternalUnits(result.Length,dispunits)/precision)
				else:
					nums = normalize(UnitUtils.ConvertToInternalUnits(result.Length,doc.GetUnits().GetFormatOptions(SpecTypeId.Length).GetUnitTypeId())/precision)
				for n in nums:
					points.append(dg.Curve.PointAtParameter(result,n))
			elif isinstance(elem,DividedPath):
				geom = elem.get_Geometry(opt1)
				for g in geom:
					divpoints.append(g.Coord.ToPoint())
		if divpath.IsClosedLoop:
			curve = dg.NurbsCurve.ByControlPoints(points,3,True)
		else:
			curve = dg.NurbsCurve.ByControlPoints(points,3)
		for p in divpoints:
			planes.append(dg.Plane.ByOriginNormal(p,dg.Curve.TangentAtParameter(curve,dg.Curve.ParameterAtPoint(curve,p))))
		return result,planes
	else:
		return None,[None]

result = []
planes = []
for divpath in divpathlist:
	operation = divOP(divpath)
	result.append(operation[0])
	planes.append(operation[1])
OUT = result,planes
# ----------------------------------------
code_block = CodeBlock(a=python_script) { a[0]; a[1]; }
VARCurves = Output(code_block.out0)
VARPlanes = Output(code_block.out1)
