# Dynamo custom node Polygon.ByPoints Fixer.dyf (Dynamo 2.1.0.7500)
# category: Synthesize.Fixers
# Polygon.ByPoints Fixer

VARpoints = Input(VARpoints: Autodesk.DesignScript.Geometry.Point[])
byPoints = Polygon.ByPoints(points=VARpoints)
VARPolygon = Output(byPoints)
