# Dynamo custom node Prepare Clean Pattern.dyf (Dynamo 2.1.0.7500)
# category: Synthesize.Automate.Adaptive
# Prepare Clean Pattern

VARFaces = Input(VARFaces: var[]..[])
flatten = List.Flatten(list=VARFaces)
get_divided_surfaces_of_surfaces = Custom[Get Divided Surfaces of Surfaces](VARSurfaces=flatten)  # Get Divided Surfaces of Surfaces
isNull = Object.IsNull(obj=get_divided_surfaces_of_surfaces)
filterByBoolMask = List.FilterByBoolMask(list=get_divided_surfaces_of_surfaces, mask=isNull)
get_family_instances_of_divided = Custom[Get Family Instances of Divided Surface](VARDividedSurfaces=filterByBoolMask.out)  # Get Family Instances of Divided Surface
code_block = CodeBlock { true; }
location_of_any_element = Custom[Location Of Any Element](VARElements=get_family_instances_of_divided@L2, VARGetAllPointsOfAdaptiveComponents=code_block)  # Location Of Any Element
filterByBoolMask_2 = List.FilterByBoolMask(list=flatten, mask=isNull)
VARTollerance = Input(VARTollerance: double = 0.2)
VARBorderDetectionTollerance = Input(VARBorderDetectionTollerance: double = 1)
python_script = Python(IN[0]=location_of_any_element.VARLocations, IN[1]=filterByBoolMask_2.out, IN[2]=location_of_any_element.VARElements, IN[3]=VARTollerance, IN[4]=VARBorderDetectionTollerance)
# ---------- python_script.python (205 lines) ----------
# Enable Python support and load DesignScript library
# IMPORTANT : ALL DYNAMO DESIGN SCRIPT NODES ARE AS (dg)
import clr
clr.AddReference('ProtoGeometry')
from Autodesk.DesignScript import Geometry as dg

# EXTENSION Enable ToDSType
clr.AddReference('RevitNodes')
import Revit
clr.ImportExtensions(Revit.Elements)

# Enable Revit Elements
from Revit.Elements import *

# EXTENSION Enable Geometry Conversion Methods
clr.ImportExtensions(Revit.GeometryConversion)

# Enable Revit API
clr.AddReference('RevitAPI')
from Autodesk.Revit.DB import *

# Enable DocumentManager and TransactionManager
clr.AddReference('RevitServices')
from RevitServices.Persistence import DocumentManager
from RevitServices.Transactions import TransactionManager

# Enable ICollection List Translate
clr.AddReference("System")
import System.Collections.Generic
from System.Collections.Generic import List

dataEnteringNode = IN
# Use UnwrapElement(IN[0]) When Translating From Dynamo to Revit
pts=UnwrapElement(IN[0])
surfs=UnwrapElement(IN[1])
pats=UnwrapElement(IN[2])
tollerance=IN[3]
borderstollerance=IN[4]
statictollerance=0.05

# Choose The Current Document
doc = DocumentManager.Instance.CurrentDBDocument
uidoc = DocumentManager.Instance.CurrentUIApplication.ActiveUIDocument
uiapp = DocumentManager.Instance.CurrentUIApplication
app = uiapp.Application

def intersects(a,b,tollerance):
	if round(dg.Geometry.DistanceTo(a,b),2) < tollerance:
		return True
	else:
		return False

# Create Empty List
result = []

border = []
interior = []
faulty = []
todelete = []

interperm = []

counter = 0
for s in surfs:
	tmpborder = []
	tmpinterior = []
	tmpfaulty = []
	tmppoly = []
	tmptodelete = []
	problems = []
	currentptslist = pts[counter]
	perimeter = s.PerimeterCurves()
	outercounter = 0
	for currentpts in currentptslist:
		currentpat = pats[counter][outercounter]
		outercounter += 1
		isinterior = []
		isborder = []
		isfaulty = []
		for p in currentpts:
			isinterior.append(True)
			isborder.append(False)
			isfaulty.append(False)
			for per in perimeter:
				if intersects(p,per,statictollerance):
					isinterior.append(False)
					isborder.append(True)
					isfaulty.append(False)
					break
			if intersects(p,s,statictollerance) == False:
				isinterior.append(False)
				isborder.append(False)
				isfaulty.append(True)
			if any(isfaulty):
				status = "Faulty"
			elif any(isborder):
				status = "Border"
			else:
				status = "Interior"
		if status == "Interior":
			#tmpinterior.append(currentpat)
			patlines = dg.Geometry.Explode(dg.Polygon.ByPoints(currentpts))
			intpts = []
			for line in patlines:
				intpts.append(line.StartPoint)
			tmpinterior.append(intpts)
		elif status == "Border":
			tmpborder.append(currentpts)
			tmptodelete.append(currentpat)
		elif status == "Faulty":
			patlines = dg.Geometry.Explode(dg.Polygon.ByPoints(currentpts))
			toconnect = []
			for line in patlines:
				stp = line.StartPoint
				enp = line.EndPoint
				isoutside = []
				if intersects(line,s,statictollerance) == False:
					isoutside.append(True)
				else:	
					isoutside.append(False)
				if all(isoutside):
					continue
				interperm = []
				isinside = []
				for perm in perimeter:
					if intersects(perm,line,borderstollerance) == False:
						isinside.append(True)
					else:
						isinside.append(False)
						interperm.append(perm)				
				if all(isinside):
					toconnect.append(stp)
					toconnect.append(enp)
					continue
				else:
					if intersects(stp,s,statictollerance):
						toconnect.append(stp)
					for per in interperm:
						try:
							closest = dg.Geometry.ClosestPointTo(line,per)
							toconnect.append(closest)
						except:
							pass
					if intersects(enp,s,statictollerance):
						toconnect.append(enp)
			try:
				poly = dg.Polygon.ByPoints(toconnect)
				cleanup = dg.Point.PruneDuplicates(poly.Points,tollerance)
				poly.Dispose()
				try:
					poly2 = dg.Polygon.ByPoints(cleanup)
					tmpfaulty.append(cleanup)
					tmptodelete.append(currentpat)
					poly2.Dispose()
				except:
					pass
			except:
				pruned = dg.Point.PruneDuplicates(toconnect,tollerance)
				if len(pruned) > 2:
					try:
						poly3 = dg.Polygon.ByPoints(pruned)
						tmptodelete.append(currentpat)
						tmpfaulty.append(poly3.Points)
						tmptodelete.append(currentpat)
						poly3.Dispose()
					except:
						pass
				elif len(pruned) == 2:
					try:
						miniline = dg.Line.ByStartPointEndPoint(pruned[0],pruned[1])
						dises = []
						ptstoadd = []
						for perm in perimeter:
							minipt = perm.StartPoint
							dises.append(dg.Geometry.DistanceTo(miniline,minipt))
							ptstoadd.append(minipt)
						mindis = min(dises)
						discount = 0
						for dis in dises:
							if mindis == dis:
								toadd = ptstoadd[discount]
								break
							discount += 1
						pruned = list(pruned)
						pruned.append(toadd)
						tmpfaulty.append(pruned)
						tmptodelete.append(currentpat)
					except:
						pass
	counter += 1
	if len(tmpborder) == 0:
		tmpborder.append(None)
	if len(tmpinterior) == 0:
		tmpinterior.append(None)
	if len(tmpfaulty) == 0:
		tmpfaulty.append(None)
	if len(tmptodelete) == 0:
		tmptodelete.append(None)
	faulty.append(tmpfaulty)
	border.append(tmpborder)
	todelete.append(tmptodelete)
	interior.append(tmpinterior)

# Assign your output to the OUT variable.
OUT = faulty,border,todelete,interior
# ----------------------------------------
code_block_2 = CodeBlock(a=python_script) { a[0]; a[1]; a[2]; a[3]; }
VARFaultyPatternPoints = Output(code_block_2.out0)
VARBorderPatternPoints = Output(code_block_2.out1)
VARToDeletePatterns = Output(code_block_2.out2)
VARFaces_2 = Output(filterByBoolMask_2.out)  # "VARFaces"
VARInteriorPoints = Output(code_block_2.out3)
