# Dynamo custom node Prepare K-Paneling Manual Lines UV.dyf (Dynamo 2.1.0.7500)
# category: Synthesize.Automate.Lines
# Prepare K-Paneling Manual Lines UV

VARFaces = Input(VARFaces: var[]..[])
turnIntoList = Custom[CW.TurnIntoList](VARunknownItem=VARFaces)  # Turns an element (or a nested list) into a flat list
flatten = List.Flatten(list=turnIntoList)
VARSurfaces = Output(flatten)
VARElements = Input(VARElements: var[]..[])
turnIntoList_2 = Custom[CW.TurnIntoList](VARunknownItem=VARElements)
flatten_2 = List.Flatten(list=turnIntoList_2)
python_script = Python(IN[0]=flatten_2)
# ---------- python_script.python (99 lines) ----------
# Enable Python support and load DesignScript library
# IMPORTANT : ALL DYNAMO DESIGN SCRIPT NODES ARE AS (dg)
import clr
clr.AddReference('ProtoGeometry')
from Autodesk.DesignScript import Geometry as dg

# EXTENSION Enable ToDSType
clr.AddReference('RevitNodes')
import Revit
clr.ImportExtensions(Revit.Elements)

# Enable Revit Elements
from Revit.Elements import *

# EXTENSION Enable Geometry Conversion Methods
clr.ImportExtensions(Revit.GeometryConversion)

# Enable Revit API
clr.AddReference('RevitAPI')
from Autodesk.Revit.DB import *

# Enable DocumentManager and TransactionManager
clr.AddReference('RevitServices')
from RevitServices.Persistence import DocumentManager
from RevitServices.Transactions import TransactionManager

# Enable ICollection List Translate
clr.AddReference("System")
import System.Collections.Generic
from System.Collections.Generic import List

def flatten(x):
    result = []
    for el in x:
        if hasattr(el, "__iter__") and not isinstance(el, basestring):
            result.extend(flatten(el))
        else:
            result.append(el)
    return result

dataEnteringNode = IN
# Use UnwrapElement(IN[0]) When Translating From Dynamo to Revit
elems=IN[0]

# Choose The Current Document
doc = DocumentManager.Instance.CurrentDBDocument
uidoc = DocumentManager.Instance.CurrentUIApplication.ActiveUIDocument
uiapp = DocumentManager.Instance.CurrentUIApplication
app = uiapp.Application

# Create Empty List
result = []

Us = []
Vs = []
Ws = []
filter = ElementClassFilter(FamilyInstance)
for e in elems:
	e = doc.GetElement(ElementId(e.Id))
	try:
		if e.ToString() == "Autodesk.Revit.DB.ComponentRepeater":
			fame = doc.GetElement(e.DefaultFamilyType)
			parms = fame.GetOrderedParameters()
			for parm in parms:
				parname = parm.Definition.Name.lower()
				if parname == "type comments":
					try:
						name = parm.AsString().lower()
					except:
						name = "u"
			allelems = e.GetDependentElements(filter)
			e = []
			for al in allelems:
				e.append(doc.GetElement(al))
		else:
			try:
				name = e.Subcategory.Name.lower()
			except:
				try:
					name = e.LineStyle.Name.lower()
				except:
					parms = e.GetOrderedParameters()
					for parm in parms:
						parname = parm.Definition.Name.lower()
						if parname == "comments":
							name = parm.AsString().lower()
		if "u" in name:
			Us.append(e)
		elif "v" in name:
			Vs.append(e)
		elif "w" in name:
			Ws.append(e)
		else:
			Us.append(e)
	except:
		Us.append(e)
		
# Assign your output to the OUT variable.
OUT = flatten(Us),flatten(Vs),flatten(Ws)
# ----------------------------------------
code_block = CodeBlock(u=python_script, v=python_script, w=python_script) { u[0]; v[1]; w[2]; }
prepare_k_paneling_manual_lines = Custom[Prepare K-Paneling Manual Lines](VARSurfaces=flatten, VARElements=code_block.out0)  # Prepare K-Paneling Manual Lines
group_curves_by_surfaces = Custom[Group Curves By Surfaces](VARSurfaces=flatten, VARCurves=prepare_k_paneling_manual_lines)  # Group Curves By Surfaces
prepare_k_paneling_manual_lines_2 = Custom[Prepare K-Paneling Manual Lines](VARSurfaces=flatten, VARElements=code_block.out1)
group_curves_by_surfaces_2 = Custom[Group Curves By Surfaces](VARSurfaces=flatten, VARCurves=prepare_k_paneling_manual_lines_2)
prepare_k_paneling_manual_lines_3 = Custom[Prepare K-Paneling Manual Lines](VARSurfaces=flatten, VARElements=code_block.out2)
group_curves_by_surfaces_3 = Custom[Group Curves By Surfaces](VARSurfaces=flatten, VARCurves=prepare_k_paneling_manual_lines_3)
create = List.Create(item0=group_curves_by_surfaces.VARCurves, item1=group_curves_by_surfaces_2.VARCurves, item2=group_curves_by_surfaces_3.VARCurves)
transpose = List.Transpose(lists=create)
code_block_2 = CodeBlock { 0; 1; 2; }
U = List.GetItemAtIndex(list=transpose@@L3, index=code_block_2.out0)
python_empty_2_null = Custom[Python Empty 2 Null](VARIN=U)  # Python Null 2 Empty
as_polycurve_bycurves_with = Custom[AS.[&] PolyCurve.ByCurves With Failures](VARcurves=python_empty_2_null)  # Create polycurves from an unordered list of curves.
code_block_3 = CodeBlock { 2; }
normalizeDepth = List.NormalizeDepth(list=as_polycurve_bycurves_with.VARpolyCurve, rank=code_block_3)
VARU = Output(normalizeDepth)
V = List.GetItemAtIndex(list=transpose@@L3, index=code_block_2.out1)
python_empty_2_null_2 = Custom[Python Empty 2 Null](VARIN=V)
as_polycurve_bycurves_with_2 = Custom[AS.[&] PolyCurve.ByCurves With Failures](VARcurves=python_empty_2_null_2)
normalizeDepth_2 = List.NormalizeDepth(list=as_polycurve_bycurves_with_2.VARpolyCurve, rank=code_block_3)
VARV = Output(normalizeDepth_2)
W = List.GetItemAtIndex(list=transpose@@L3, index=code_block_2.out2)
python_empty_2_null_3 = Custom[Python Empty 2 Null](VARIN=W)
as_polycurve_bycurves_with_3 = Custom[AS.[&] PolyCurve.ByCurves With Failures](VARcurves=python_empty_2_null_3)
normalizeDepth_3 = List.NormalizeDepth(list=as_polycurve_bycurves_with_3.VARpolyCurve, rank=code_block_3)
VARW = Output(normalizeDepth_3)
