# Dynamo custom node Prepare K-Paneling Manual Lines.dyf (Dynamo 2.1.0.7500)
# category: Synthesize.Automate.Lines
# Prepare K-Paneling Manual Lines

VARSurfaces = Input(VARSurfaces: var[]..[])
flatten = List.Flatten(list=VARSurfaces)
VARElements = Input(VARElements: var[]..[])
geometry_and_vector_of_model = Custom[Geometry and Vector of Model Curves and Curve By Points With Helping Surfaces](VARElements=VARElements, VARSurfaces=flatten)  # Geometry and Vector of Model Curves and Curve By Points
python_script = Python(IN[0]=flatten, IN[1]=geometry_and_vector_of_model.VARCurves)
# ---------- python_script.python (97 lines) ----------
# Enable Python support and load DesignScript library
# IMPORTANT : ALL DYNAMO DESIGN SCRIPT NODES ARE AS (dg)
import clr
clr.AddReference('ProtoGeometry')
from Autodesk.DesignScript import Geometry as dg

# EXTENSION Enable ToDSType
clr.AddReference('RevitNodes')
import Revit
clr.ImportExtensions(Revit.Elements)

# Enable Revit Elements
from Revit.Elements import *

# EXTENSION Enable Geometry Conversion Methods
clr.ImportExtensions(Revit.GeometryConversion)

# Enable Revit API
clr.AddReference('RevitAPI')
from Autodesk.Revit.DB import *

# Enable DocumentManager and TransactionManager
clr.AddReference('RevitServices')
from RevitServices.Persistence import DocumentManager
from RevitServices.Transactions import TransactionManager

# Enable ICollection List Translate
clr.AddReference("System")
import System.Collections.Generic
from System.Collections.Generic import List

dataEnteringNode = IN
# Use UnwrapElement(IN[0]) When Translating From Dynamo to Revit
surfs=UnwrapElement(IN[0])
curves=UnwrapElement(IN[1])

# Choose The Current Document
doc = DocumentManager.Instance.CurrentDBDocument
uidoc = DocumentManager.Instance.CurrentUIApplication.ActiveUIDocument
uiapp = DocumentManager.Instance.CurrentUIApplication
app = uiapp.Application

def isfreeline(curve,surfs):
	freeline = True
	stp = curve.StartPoint
	end = curve.EndPoint
	for s in surfs:
		try:
			if dg.Geometry.DoesIntersect(stp,s) or dg.Geometry.DoesIntersect(end,s):
				freeline = False
				break
		except:
			pass
	return freeline

# Create Empty List
result = []

pts = []
for c in curves:
	pts.append([dg.Curve.PointAtParameter(c,0.33),dg.Curve.PointAtParameter(c,0.66)])

counter = 0
goodcurves = []
goodsurfs = []
badcurves = []
badsurfs = []
boolit = []
for p in pts:
	inter = True
	dises = []
	for s in surfs:
		try:
			dis1 = round(dg.Geometry.DistanceTo(p[0],s),2)
			dis2 = round(dg.Geometry.DistanceTo(p[1],s),2)
			distotal = dis1 + dis2
			if distotal == 0:
				goodcurves.append(curves[counter])
				goodsurfs.append(s)
				boolit.append(False)
				inter = False
				break
			else:
				dises.append(distotal)
		except:
			pass
	if inter == True:
		if isfreeline(curves[counter],surfs):
			badsurfs.append(surfs)
		else:
			badsurfs.append(surfs[dises.IndexOf(min(dises))])
		badcurves.append(curves[counter])
		boolit.append(True)
	counter += 1

# Assign your output to the OUT variable.
OUT = goodcurves,goodsurfs,badcurves,badsurfs,boolit
# ----------------------------------------
code_block = CodeBlock(a=python_script) { a[0]; a[1]; a[2]; a[3]; a[4]; }
join = List.Join()  # unwired: list0, list1
filterByBoolMask = List.FilterByBoolMask(list=geometry_and_vector_of_model.VARVectors, mask=code_block.out4)
python_script_2 = Python(IN[0]=code_block.out2, IN[1]=flatten)
# ---------- python_script_2.python (70 lines) ----------
# Enable Python support and load DesignScript library
# IMPORTANT : ALL DYNAMO DESIGN SCRIPT NODES ARE AS (dg)
import clr
clr.AddReference('ProtoGeometry')
from Autodesk.DesignScript import Geometry as dg

# EXTENSION Enable ToDSType
clr.AddReference('RevitNodes')
import Revit
clr.ImportExtensions(Revit.Elements)

# Enable Revit Elements
from Revit.Elements import *

# EXTENSION Enable Geometry Conversion Methods
clr.ImportExtensions(Revit.GeometryConversion)

# Enable Revit API
clr.AddReference('RevitAPI')
from Autodesk.Revit.DB import *

# Enable DocumentManager and TransactionManager
clr.AddReference('RevitServices')
from RevitServices.Persistence import DocumentManager
from RevitServices.Transactions import TransactionManager

# Enable ICollection List Translate
clr.AddReference("System")
import System.Collections.Generic
from System.Collections.Generic import List

dataEnteringNode = IN
# Use UnwrapElement(IN[0]) When Translating From Dynamo to Revit
curves=UnwrapElement(IN[0])
surfs=UnwrapElement(IN[1])

# Choose The Current Document
doc = DocumentManager.Instance.CurrentDBDocument
uidoc = DocumentManager.Instance.CurrentUIApplication.ActiveUIDocument
uiapp = DocumentManager.Instance.CurrentUIApplication
app = uiapp.Application

# Create Empty List
result = []

for c in curves:
	distances = []
	for s in surfs:
		try:
			distances.append(dg.Geometry.DistanceTo(c,s))
		except:
			distances.append(10)
	mindis = min(distances)
	midpt = dg.Curve.PointAtParameter(c,0.5)
	counter = 0
	for dis in distances:
		if mindis == dis:
			distomid = dg.Geometry.DistanceTo(midpt,surfs[counter]) 
			break
		counter += 1
	if round(mindis,2) == 0 and round(distomid,2) < 2.5:
		mindis = c.Length/2.0
	elif mindis < 10 and distomid < 2.5:
		mindis = 10
	else:
		mindis = (mindis + 1)* 100
	result.append(mindis)

# Assign your output to the OUT variable.
OUT = result
# ----------------------------------------
extrude = Curve.Extrude(curve=code_block.out2, direction=filterByBoolMask.in, distance=python_script_2)
code_block_2 = CodeBlock { false; }
clean = List.Clean(list=extrude, preserveIndices=code_block_2)
code_block_3 = CodeBlock(a=python_script_2) { a*-1; }
extrude_2 = Curve.Extrude(curve=code_block.out2, direction=filterByBoolMask.in, distance=code_block_3)
clean_2 = List.Clean(list=extrude_2, preserveIndices=code_block_2)
combine = List.Combine(comb=join, list1=clean, list2=clean_2)
code_block_4 = CodeBlock { false; }
join_adjacent_surfaces = Custom[Join Adjacent Surfaces](VARSurfaces=combine@L2, VARNormalsCheck=code_block_4)  # Join Adjacent Surfaces
flatten_2 = List.Flatten(list=join_adjacent_surfaces)
python_script_3 = Python(IN[0]=code_block.out3, IN[1]=flatten_2)
# ---------- python_script_3.python (59 lines) ----------
# Enable Python support and load DesignScript library
# IMPORTANT : ALL DYNAMO DESIGN SCRIPT NODES ARE AS (dg)
import clr
clr.AddReference('ProtoGeometry')
from Autodesk.DesignScript import Geometry as dg

# EXTENSION Enable ToDSType
clr.AddReference('RevitNodes')
import Revit
clr.ImportExtensions(Revit.Elements)

# Enable Revit Elements
from Revit.Elements import *

# EXTENSION Enable Geometry Conversion Methods
clr.ImportExtensions(Revit.GeometryConversion)

# Enable Revit API
clr.AddReference('RevitAPI')
from Autodesk.Revit.DB import *

# Enable DocumentManager and TransactionManager
clr.AddReference('RevitServices')
from RevitServices.Persistence import DocumentManager
from RevitServices.Transactions import TransactionManager

# Enable ICollection List Translate
clr.AddReference("System")
import System.Collections.Generic
from System.Collections.Generic import List

def tolist(obj1):
	if hasattr(obj1,'__iter__'): return obj1
	else: return [obj1]

dataEnteringNode = IN
# Use UnwrapElement(IN[0]) When Translating From Dynamo to Revit
surfs1=UnwrapElement(IN[0])
surfs2=UnwrapElement(IN[1])

# Choose The Current Document
doc = DocumentManager.Instance.CurrentDBDocument
uidoc = DocumentManager.Instance.CurrentUIApplication.ActiveUIDocument
uiapp = DocumentManager.Instance.CurrentUIApplication
app = uiapp.Application

# Create Empty List
result = []
counter = 0
for s in surfs1:
	try:
		s = tolist(s)
		for sin in s:
			result.append(dg.Geometry.Intersect(sin,surfs2[counter]))
	except:
		result.append(None)
	counter += 1
# Assign your output to the OUT variable.
OUT = result
# ----------------------------------------
join_2 = List.Join()  # unwired: list0, list1
code_block_5 = CodeBlock { 3.28; }
unit_types = UnitTypes("Length")  # graph input
displayUnitType = Custom[CW.UnitType.DisplayUnitType](VARunitType=unit_types)  # Retrieves the display unit type for a given unit type.
toDisplayUnit = Custom[CW.InternalUnit.ToDisplayUnit](VARval=code_block_5, VARdisplayUnitType=displayUnitType.VARdisplayUnitType)  # Converts a value from Revit's internal unit to a given display unit
extrude_3 = Curve.Extrude(curve=code_block.out0, direction=filterByBoolMask.out, distance=toDisplayUnit)
code_block_6 = CodeBlock { false; }
clean_3 = List.Clean(list=extrude_3, preserveIndices=code_block_6)
code_block_7 = CodeBlock(a=toDisplayUnit) { a*-1; }
extrude_4 = Curve.Extrude(curve=code_block.out0, direction=filterByBoolMask.out, distance=code_block_7)
clean_4 = List.Clean(list=extrude_4, preserveIndices=code_block_6)
combine_2 = List.Combine(comb=join_2, list1=clean_3, list2=clean_4)
code_block_8 = CodeBlock { false; }
join_adjacent_surfaces_2 = Custom[Join Adjacent Surfaces](VARSurfaces=combine_2@L2, VARNormalsCheck=code_block_8)
flatten_3 = List.Flatten(list=join_adjacent_surfaces_2)
python_script_4 = Python(IN[0]=flatten_3, IN[1]=code_block.out1)
# ---------- python_script_4.python (53 lines) ----------
# Enable Python support and load DesignScript library
# IMPORTANT : ALL DYNAMO DESIGN SCRIPT NODES ARE AS (dg)
import clr
clr.AddReference('ProtoGeometry')
from Autodesk.DesignScript import Geometry as dg

# EXTENSION Enable ToDSType
clr.AddReference('RevitNodes')
import Revit
clr.ImportExtensions(Revit.Elements)

# Enable Revit Elements
from Revit.Elements import *

# EXTENSION Enable Geometry Conversion Methods
clr.ImportExtensions(Revit.GeometryConversion)

# Enable Revit API
clr.AddReference('RevitAPI')
from Autodesk.Revit.DB import *

# Enable DocumentManager and TransactionManager
clr.AddReference('RevitServices')
from RevitServices.Persistence import DocumentManager
from RevitServices.Transactions import TransactionManager

# Enable ICollection List Translate
clr.AddReference("System")
import System.Collections.Generic
from System.Collections.Generic import List

dataEnteringNode = IN
# Use UnwrapElement(IN[0]) When Translating From Dynamo to Revit
surfs1=UnwrapElement(IN[0])
surfs2=UnwrapElement(IN[1])

# Choose The Current Document
doc = DocumentManager.Instance.CurrentDBDocument
uidoc = DocumentManager.Instance.CurrentUIApplication.ActiveUIDocument
uiapp = DocumentManager.Instance.CurrentUIApplication
app = uiapp.Application

# Create Empty List
result = []
counter = 0
for s in surfs1:
	try:
		result.append(dg.Geometry.Intersect(s,surfs2[counter]))
	except:
		result.append(None)
	counter += 1
# Assign your output to the OUT variable.
OUT = result
# ----------------------------------------
create = List.Create(item0=python_script_3, item1=python_script_4)
code_block_9 = CodeBlock { false; }
clean_5 = List.Clean(list=create, preserveIndices=code_block_9)
flatten_4 = List.Flatten(list=clean_5)
code_block_10 = CodeBlock { "Point"; }
byClassName = Custom[SP.Filter.ByClassName](VARobject=flatten_4, VARclassName=code_block_10)  # Filters a list of objects by the object's class name. Note that Dynamo elements belong to different classes than their Revit counterparts. Use the Object.Class node to check an object's class.
code_block_11 = CodeBlock { false; }
clean_6 = List.Clean(list=byClassName.VARout, preserveIndices=code_block_11)
flatten_5 = List.Flatten(list=clean_6)
code_block_12 = CodeBlock { "Surface"; "Point"; }
byClassName_2 = Custom[SP.Filter.ByClassName](VARobject=flatten_5, VARclassName=code_block_12.out0)
byClassName_3 = Custom[SP.Filter.ByClassName](VARobject=byClassName_2.VARout, VARclassName=code_block_12.out0)
VARCurves = Output(byClassName_3.VARout)
