# Dynamo custom node Pull Onto Surface Or Plane.dyf (Dynamo 2.1.0.7500)
# category: Synthesize.Automate.Surface
# Pull Onto Surface Or Plane

VARCurves = Input(VARCurves: var[]..[])
VARSurface = Input(VARSurface: var[]..[])
isPlanar = Custom[CW.Surface.IsPlanar](VARsurface=VARSurface)  # Checks whether a face is planar
filterByBoolMask = List.FilterByBoolMask(list=VARCurves, mask=isPlanar)
code_block = CodeBlock { 0.5; }
pointAtParameter = Surface.PointAtParameter(surface=VARSurface, u=code_block, v=code_block)
normalAtPoint = Surface.NormalAtPoint(surface=VARSurface, point=pointAtParameter)
byOriginNormal = Plane.ByOriginNormal(origin=pointAtParameter, normal=normalAtPoint)
filterByBoolMask_2 = List.FilterByBoolMask(list=byOriginNormal, mask=isPlanar)
pullOntoPlane = Curve.PullOntoPlane(curve=filterByBoolMask.in, plane=filterByBoolMask_2.in)
filterByBoolMask_3 = List.FilterByBoolMask(list=VARSurface, mask=isPlanar)
pullOntoSurface = Curve.PullOntoSurface(curve=filterByBoolMask.out, surface=filterByBoolMask_3.out)
mergeByBoolMask = Custom[SP.List.MergeByBoolMask](VARIn=pullOntoPlane, VAROut=pullOntoSurface, VARmask=isPlanar)  # Merge two lists by a boolean mask list. The true count in the mask should be the same as the length of the true list and vice versa for the false list.
VARPulledCurves = Output(mergeByBoolMask)
