# Dynamo custom node Python Dispose.dyf (Dynamo 2.1.0.7500)
# category: Synthesize.Python
# Python Flatten

VARList = Input(VARList: var[]..[])
python_script = Python(IN[0]=VARList)
# ---------- python_script.python (28 lines) ----------
# Enable Python support and load DesignScript library
# IMPORTANT : ALL DYNAMO DESIGN SCRIPT NODES ARE AS (dg)
import clr
clr.AddReference('ProtoGeometry')
from Autodesk.DesignScript import Geometry as dg

def tolist(obj1):
	if hasattr(obj1,'__iter__'): return obj1
	else: return [obj1]

def flatten(x):
    result = []
    for el in x:
        if hasattr(el, "__iter__") and not isinstance(el, basestring):
            result.extend(flatten(el))
        else:
            result.append(el)
    return result

flatteninput = flatten(tolist(IN[0]))

for f in flatteninput:
	try:
		f.Dispose()
	except:
		pass

OUT = flatteninput
# ----------------------------------------
VAROutput = Output(python_script)
