# Dynamo custom node Python Empty 2 False.dyf (Dynamo 2.1.0.7500)
# category: Synthesize.Python
# Python Null 2 Empty

VARIN = Input(VARIN: var[]..[])
python_script = Python(IN[0]=VARIN)
# ---------- python_script.python (20 lines) ----------
import clr
clr.AddReference('ProtoGeometry')
from Autodesk.DesignScript.Geometry import *
#The inputs to this node will be stored as a list in the IN variables.

inpo = IN[0]
result = []

if isinstance(inpo, (list,)):
	for each in inpo:
		if each == []:
			result.append(False)
		else:
			result.append(each)
elif inpo == []:
	result = False
else:
	result = inpo
#Assign your output to the OUT variable.
OUT = result
# ----------------------------------------
VAROUT = Output(python_script)
