# Dynamo custom node Python Flatten.dyf (Dynamo 2.1.0.7500)
# category: Synthesize.Python
# Python Flatten

VARList = Input(VARList: var[]..[])
python_script = Python(IN[0]=VARList)
# ---------- python_script.python (19 lines) ----------
import clr
clr.AddReference('ProtoGeometry')
from Autodesk.DesignScript.Geometry import *

def flatten(x):
    result = []
    for el in x:
        if hasattr(el, "__iter__") and not isinstance(el, basestring):
            result.extend(flatten(el))
        else:
            result.append(el)
    return result
    
try:
	result = flatten(IN[0])
except:
	result = IN[0]
	
OUT = result
# ----------------------------------------
VAROutput = Output(python_script)
