# Dynamo custom node Python Null 2 String.dyf (Dynamo 2.1.0.7500)
# category: Synthesize.Python
# Python Null 2 String

VARIN = Input(VARIN: var[]..[])
VARString = Input(VARString: var[]..[])
python_script = Python(IN[0]=VARIN, IN[1]=VARString)
# ---------- python_script.python (21 lines) ----------
import clr
clr.AddReference('ProtoGeometry')
from Autodesk.DesignScript.Geometry import *
#The inputs to this node will be stored as a list in the IN variables.

inpo = IN[0]
string = IN[1]
result = []

if isinstance(inpo, (list,)):
	for each in inpo:
		if each == None:
			result.append(string)
		else:
			result.append(each)
elif inpo == None:
	result = string
else:
	result = inpo
#Assign your output to the OUT variable.
OUT = result
# ----------------------------------------
VAROUT = Output(python_script)
