# Dynamo custom node QU.ViewDuplicate.dyf (Dynamo 2.1.0.7500)
# category: Synthesize.Packages.Quasar.Revit.Views
# Duplicate views with given names.

VARViews = Input(VARViews: var[]..[])
VARNames = Input(VARNames: var[]..[])
VARDetailing = Input(VARDetailing: bool = False)
python_script = Python(IN[0]=VARViews, IN[1]=VARNames, IN[2]=VARDetailing)
# ---------- python_script.python (37 lines) ----------
# dynamo version - 1.3.0
# author - mgjean

import clr
clr.AddReference("RevitAPI")
from Autodesk.Revit.DB import *
clr.AddReference("RevitServices")
import RevitServices
from RevitServices.Persistence import DocumentManager
from RevitServices.Transactions import TransactionManager
doc = DocumentManager.Instance.CurrentDBDocument

views = IN[0]
names = IN[1]
detailing = IN[2]
res = []

if not isinstance(views,list):
	views = UnwrapElement([views])
else:
	views = UnwrapElement(views)

if not isinstance(names,list):
	names = [names]

TransactionManager.Instance.EnsureInTransaction(doc);
for i,n in zip(views,names):
	if detailing:
		v = i.Duplicate(ViewDuplicateOption.WithDetailing)
	else:
		v = i.Duplicate(ViewDuplicateOption.Duplicate)
	dupview = doc.GetElement(v)
	dupview.Name = n
	res.append(dupview)
TransactionManager.Instance.TransactionTaskDone();

OUT = res
# ----------------------------------------
VARViews_2 = Output(python_script)  # "VARViews"
