# Dynamo custom node QU.ViewPorts Schedules Alignment.dyf (Dynamo 2.1.0.7500)
# category: Synthesize.Packages.Quasar.Revit.Sheet
# This note relocate viewports positions for given sheets , according template sheet viewports positions including schedules.

VARTemplateSheet = Input(VARTemplateSheet: var[]..[])
VARSheets = Input(VARSheets: var[]..[])
python_script = Python(IN[0]=VARTemplateSheet, IN[1]=VARSheets)
# ---------- python_script.python (47 lines) ----------
# dynamo version - 1.3.0
# author - mgjean

import clr
clr.AddReference("RevitAPI")
clr.AddReference("RevitNodes")
clr.AddReference("RevitServices")
import Autodesk, Revit, RevitServices
from Autodesk.Revit.DB import *
from RevitServices.Persistence import DocumentManager
from RevitServices.Transactions import TransactionManager

doc = DocumentManager.Instance.CurrentDBDocument

template = UnwrapElement(IN[0]);
sheets = IN[1];
result = [];
if not isinstance(sheets,list):
	sheets = UnwrapElement([sheets]);
else:
	sheets = UnwrapElement(sheets);

TransactionManager.Instance.EnsureInTransaction(doc);
sub =[]

for s in sheets:
		
	#collect all viewports from template sheet
	temp_ports = FilteredElementCollector(doc).OwnedByView(template.Id);
	#collect all viewports from current sheet
	view_ports = FilteredElementCollector(doc).OwnedByView(s.Id);
	
	#template sheet schedule views
	temp_schedules = [i for i in temp_ports if  i.Category != None and i.Category.Name == "Schedule Graphics" and i.IsTitleblockRevisionSchedule == False];

	#sheet schedule views
	s_schedules = [i for i in view_ports if  i.Category != None and i.Category.Name == "Schedule Graphics" and i.IsTitleblockRevisionSchedule == False];
	
	#get/set location
	for ts,ss in zip(temp_schedules,s_schedules):
		ss.Point = ts.Point;
		
	sub.append([s_schedules]);

TransactionManager.Instance.TransactionTaskDone();

OUT = sub;
# ----------------------------------------
VARViewports = Output(python_script)
