# Dynamo custom node Quad or Adaptive Points On Surface Prepare.dyf (Dynamo 2.1.0.7500)
# category: Synthesize.Automate.Adaptive
# Quad or Adaptive Points On Surface Prepare

VARFalsePatternTrueAdaptive = Input(VARFalsePatternTrueAdaptive: var[]..[])
VARFlaseUTrueV = Input(VARFlaseUTrueV: var[]..[])
VARUVPoints = Input(VARUVPoints: var[]..[])
transpose = List.Transpose(lists=VARUVPoints@L3)
scopeIf = Custom[CW.ScopeIf+](VARtest=VARFlaseUTrueV, VARtrue=VARUVPoints, VARfalse=transpose)  # A (hopefully) more robust implementation of ScopeIf. Tests a single boolean and returns a value accordingly.
code_block = CodeBlock { 0; 1; }
VARXPointsNumber = Input(VARXPointsNumber: var[]..[])
code_block_2 = CodeBlock(a=VARXPointsNumber, b=code_block.out1) { a-b; }
range = Range(start=code_block.out0, end=code_block_2, lacing=Longest)
sublists = List.Sublists(list=VARUVPoints@@L2, ranges=range, offset=code_block_2)
transpose_2 = List.Transpose(lists=sublists@@L4)
VARYPointsNumber = Input(VARYPointsNumber: var[]..[])
code_block_3 = CodeBlock(a=VARYPointsNumber, b=code_block.out1) { a-b; }
range_2 = Range(start=code_block.out0, end=code_block_3, lacing=Longest)
sublists_2 = List.Sublists(list=transpose_2@@L3, ranges=range_2, offset=code_block_3)
flatten = List.Flatten(list=sublists_2@@L3)
count = List.Count(list=flatten@@L2)
code_block_4 = CodeBlock { 3; }
gt = count > code_block_4
filterByBoolMask = List.FilterByBoolMask(list=flatten, mask=gt)
code_block_5 = CodeBlock { false; }
clean = List.Clean(list=filterByBoolMask.in, preserveIndices=code_block_5)
flatten_2 = List.Flatten(list=clean@L2)
count_2 = List.Count(list=flatten_2)
VARSurfaces = Input(VARSurfaces: var[]..[])
count_3 = List.Count(list=VARSurfaces)
div = count_2 / count_3
chop = List.Chop(list=flatten_2, lengths=div)
count_4 = List.Count(list=chop@@L2)
code_block_6 = CodeBlock { 4; }
eq = count_4 == code_block_6
allTrue = List.AllTrue(list=eq@L2)
empty = List.Empty()
scopeIf_2 = Custom[CW.ScopeIf+](VARtest=allTrue, VARtrue=chop, VARfalse=empty)
filterByBoolMask_2 = List.FilterByBoolMask(list=scopeIf_2, mask=eq)
code_block_7 = CodeBlock { 3; 2; }
code_block_8 = CodeBlock { 2; 3; }
getItemAtIndex = List.GetItemAtIndex(list=filterByBoolMask_2.in@L2, index=code_block_8.out0)
replaceItemAtIndex = List.ReplaceItemAtIndex(list=filterByBoolMask_2.in@@L2, index=code_block_7.out0, item=getItemAtIndex, lacing=Longest)
getItemAtIndex_2 = List.GetItemAtIndex(list=filterByBoolMask_2.in@L2, index=code_block_8.out1)
replaceItemAtIndex_2 = List.ReplaceItemAtIndex(list=replaceItemAtIndex@@L2, index=code_block_7.out1, item=getItemAtIndex_2, lacing=Longest)
scopeIf_3 = Custom[CW.ScopeIf+](VARtest=allTrue, VARtrue=replaceItemAtIndex_2, VARfalse=chop)
scopeIf_4 = Custom[CW.ScopeIf+](VARtest=VARFalsePatternTrueAdaptive, VARtrue=scopeIf, VARfalse=scopeIf_3)
VARPointsList = Output(scopeIf_4)
VARShowPolygons = Input(VARShowPolygons: bool = false)
empty_2 = List.Empty()
scopeIf_5 = Custom[CW.ScopeIf+](VARtest=VARShowPolygons, VARtrue=VARUVPoints, VARfalse=empty_2)
transpose_3 = List.Transpose(lists=scopeIf_5@L3)
scopeIf_6 = Custom[CW.ScopeIf+](VARtest=VARFlaseUTrueV, VARtrue=scopeIf_5, VARfalse=transpose_3)
code_block_9 = CodeBlock { 0; 1; }
code_block_10 = CodeBlock(b=code_block_9.out1) { 2-b; }
range_3 = Range(start=code_block_9.out0, end=code_block_10, lacing=Longest)
sublists_3 = List.Sublists(list=scopeIf_5@@L2, ranges=range_3, offset=code_block_10)
transpose_4 = List.Transpose(lists=sublists_3@@L4)
code_block_11 = CodeBlock(b=code_block_9.out1) { 2-b; }
range_4 = Range(start=code_block_9.out0, end=code_block_11, lacing=Longest)
sublists_4 = List.Sublists(list=transpose_4@@L3, ranges=range_4, offset=code_block_11)
flatten_3 = List.Flatten(list=sublists_4@@L3)
count_5 = List.Count(list=flatten_3@@L2)
code_block_12 = CodeBlock { 3; }
gt_2 = count_5 > code_block_12
filterByBoolMask_3 = List.FilterByBoolMask(list=flatten_3, mask=gt_2)
code_block_13 = CodeBlock { false; }
clean_2 = List.Clean(list=filterByBoolMask_3.in, preserveIndices=code_block_13)
flatten_4 = List.Flatten(list=clean_2@L2)
count_6 = List.Count(list=flatten_4)
count_7 = List.Count(list=VARSurfaces)
div_2 = count_6 / count_7
chop_2 = List.Chop(list=flatten_4, lengths=div_2)
count_8 = List.Count(list=chop_2@@L2)
code_block_14 = CodeBlock { 4; }
eq_2 = count_8 == code_block_14
allTrue_2 = List.AllTrue(list=eq_2@L2)
empty_3 = List.Empty()
scopeIf_7 = Custom[CW.ScopeIf+](VARtest=allTrue_2, VARtrue=chop_2, VARfalse=empty_3)
filterByBoolMask_4 = List.FilterByBoolMask(list=scopeIf_7, mask=eq_2)
code_block_15 = CodeBlock { 3; 2; }
code_block_16 = CodeBlock { 2; 3; }
getItemAtIndex_3 = List.GetItemAtIndex(list=filterByBoolMask_4.in@L2, index=code_block_16.out0)
replaceItemAtIndex_3 = List.ReplaceItemAtIndex(list=filterByBoolMask_4.in@@L2, index=code_block_15.out0, item=getItemAtIndex_3, lacing=Longest)
getItemAtIndex_4 = List.GetItemAtIndex(list=filterByBoolMask_4.in@L2, index=code_block_16.out1)
replaceItemAtIndex_4 = List.ReplaceItemAtIndex(list=replaceItemAtIndex_3@@L2, index=code_block_15.out1, item=getItemAtIndex_4, lacing=Longest)
scopeIf_8 = Custom[CW.ScopeIf+](VARtest=allTrue_2, VARtrue=replaceItemAtIndex_4, VARfalse=chop_2)
scopeIf_9 = Custom[CW.ScopeIf+](VARtest=VARFalsePatternTrueAdaptive, VARtrue=scopeIf_6, VARfalse=scopeIf_8)
empty_4 = List.Empty()
scopeIf_10 = Custom[CW.ScopeIf+](VARtest=VARShowPolygons, VARtrue=scopeIf_9, VARfalse=empty_4)
byPoints = Polygon.ByPoints(points=scopeIf_10)
python_null_2_empty = Custom[Python Null 2 Empty](VARIN=byPoints)  # Python Null 2 Empty
VARPolygons = Output(python_null_2_empty)
