# Dynamo custom node RH.Element.GetJoinedElements.dyf (Dynamo 2.1.0.7500)
# category: Synthesize.Packages.Rhythm.Revit.Elements.Element
# This will obtain the elements joined to the input element.

VARelement = Input(VARelement: var[]..[])
code_block = CodeBlock(item=VARelement) { DSCore.List.Flatten([item]); }
python_script = Python(IN[0]=code_block)
# ---------- python_script.python (32 lines) ----------
import clr
clr.AddReference('RevitAPI')
from Autodesk.Revit.DB import *
from System.Collections.Generic import *
clr.AddReference("RevitServices")
import RevitServices
from RevitServices.Persistence import DocumentManager
from RevitServices.Transactions import TransactionManager

doc = DocumentManager.Instance.CurrentDBDocument
uiapp = DocumentManager.Instance.CurrentUIApplication
app = uiapp.Application

#The inputs to this node will be stored as a list in the IN variable.
dataEnteringNode = IN

#unwrap all elements to use with API
items = UnwrapElement(IN[0])
TransactionManager.Instance.EnsureInTransaction(doc)
#get the joined element ids
typelist = list()
for i in items:
	try:
		typelist.append(JoinGeometryUtils.GetJoinedElements(doc,i))
	except:
		typelist.append(List())

# "End" the transaction
TransactionManager.Instance.TransactionTaskDone()

#Assign your output to the OUT variable
OUT = typelist
# ----------------------------------------
flatten = List.Flatten(list=python_script)

# group: borrowed from Andreas Dieckmann's awesome clockwork package :)
python_script_2 = Python(IN[0]=flatten)
# ---------- python_script_2.python (23 lines) ----------
import clr
clr.AddReference('RevitAPI')
from Autodesk.Revit.DB import *

clr.AddReference("RevitNodes")
import Revit
clr.ImportExtensions(Revit.Elements)

clr.AddReference("RevitServices")
import RevitServices
from RevitServices.Persistence import DocumentManager

doc = DocumentManager.Instance.CurrentDBDocument
items = UnwrapElement(IN[0])

elementlist = list()
unmatched = list()
for item in items:
	try: 
		elementlist.append(doc.GetElement(item).ToDSType(True))
	except:
		unmatched.append(item)
OUT = (elementlist, unmatched)
# ----------------------------------------

code_block_2 = CodeBlock(x=python_script_2) { x[0]; }
count = List.Count(list=python_script, lacing=Longest)
chop = List.Chop(list=code_block_2, lengths=count)
VARjoinedElements = Output(chop)
