# Dynamo custom node RH.FilePath.dyf (Dynamo 2.1.0.7500)
# category: Synthesize.Packages.Rhythm.Revit.UI
# Provides a file path option for use with Dynamo Player.

VARrefresh = Input(VARrefresh: bool = false)
python_script = Python(IN[0]=VARrefresh)
# ---------- python_script.python (18 lines) ----------
##based off of code from http://onecore.net/ironpython-using-textbox-widget.htm
##also made possible thanks to the awesome work of Dimitar Venkov, without his examples I wouldn't be able to do any of this.
##built for Dynamo by john pierson
import clr
import sys
import System
clr.AddReference('System.Windows.Forms')
clr.AddReference('System.Drawing')
clr.AddReference('System')

from System.Drawing import Point, Font
from System.Windows.Forms import OpenFileDialog

openDialog = OpenFileDialog()
openDialog.Multiselect = True
openDialog.Filter = "All files|*.*"
openDialog.ShowDialog()
OUT = openDialog.FileNames
# ----------------------------------------
VARgt = Output(python_script)
