# Dynamo custom node RH.Rhythm.Toggle.dyf (Dynamo 2.1.0.7500)
# category: Synthesize.Packages.Rhythm.Tools
# Toggle that offers two outputs. Created for Dynamo 0.8.1 because of changes to the "IF" node

VARlist = Input(VARlist: var[]..[])
VARboolean = Input(VARboolean: bool)
count = List.Count(list=VARlist)
cycle = List.Cycle(list=VARboolean, amount=count)
filterByBoolMask = List.FilterByBoolMask(list=VARlist, mask=cycle)
VARin = Output(filterByBoolMask.in)
VARout = Output(filterByBoolMask.out)
