# Dynamo custom node RH.UI.ColorPicker.dyf (Dynamo 2.1.0.7500)
# category: Synthesize.Packages.Rhythm.Revit.UI
# This node allows the user to choose a color via the Revit API color selection dialog. For Revit 2017 +

refresh = Input(refresh: bool = false)  # togglewithbooleantorefresh
python_script = Python(IN[0]=refresh)
# ---------- python_script.python (40 lines) ----------
#Copyright(c) 2017, john pierson
# @60secondrevit, http://sixtysecondrevit.com
import clr
import msvcrt

clr.AddReference("RevitAPIUI")
from  Autodesk.Revit.UI import *

clr.AddReference("RevitServices")
import RevitServices
from RevitServices.Persistence import DocumentManager
doc = DocumentManager.Instance.CurrentDBDocument
uidoc=DocumentManager.Instance.CurrentUIApplication.ActiveUIDocument

clr.AddReference("RevitNodes")
import Revit
clr.ImportExtensions(Revit.Elements)
#Custom flatten definition to manage lists in here
def flatten(*args):
    for x in args:
        if hasattr(x, '__iter__'):
            for y in flatten(*x):
                yield y
        else:
            yield x
#Constructs the window
window = ColorSelectionDialog()
#Allows the window to popup
selected = ColorSelectionDialog.Show(window)
#Gets the selected color
userColor = window.SelectedColor
#Special thanks to andreas Dieckmann for this code.
rlist = list()
glist = list()
blist = list()
rlist.append(userColor.Red)
glist.append(userColor.Green)
blist.append(userColor.Blue)

OUT = userColor,flatten(rlist,glist,blist)
# ----------------------------------------
code_block = CodeBlock(x=python_script) { x[0]; }
VARrevitColor = Output(code_block)
code_block_2 = CodeBlock(seq=python_script) { DSCore.Color.ByARGB(255,seq[1][0],seq[1][1],seq[1][2]); }
VARdynamoColor = Output(code_block_2)
