# Dynamo custom node Ramps Auto Detail Lines.dyf (Dynamo 2.1.0.7500)
# category: Synthesize.Automate.Lines
# Ramps Auto Detail LinesRamps Auto Detail Lines

create = List.Create()  # unwired: item0, item1, item2
VARRampsFaces = Input(VARRampsFaces: var[]..[])
perimeterCurves = Surface.PerimeterCurves(surface=VARRampsFaces)
flatten = List.Flatten(list=perimeterCurves@L2)
VARRampsStartEndEdges = Input(VARRampsStartEndEdges: var[]..[])
code_block = CodeBlock { 0.5; }
pointAtParameter = Curve.PointAtParameter(curve=VARRampsStartEndEdges, param=code_block)
X = Point.X(point=pointAtParameter)
code_block_2 = CodeBlock { 2; }
round = Math.Round(number=X, digits=code_block_2)
Y = Point.Y(point=pointAtParameter)
round_2 = Math.Round(number=Y, digits=code_block_2)
Z = Point.Z(point=pointAtParameter)
round_3 = Math.Round(number=Z, digits=code_block_2)
byCoordinates = Point.ByCoordinates(x=round, y=round_2, z=round_3)
distanceTo = Geometry.DistanceTo(geometry=byCoordinates, other=flatten@@L1)
code_block_3 = CodeBlock { 1; 0; }
round_4 = Math.Round(number=distanceTo, digits=code_block_3.out0)
eq = round_4 == code_block_3.out1
anyTrue = Custom[CW.List.AnyTrue](VARseq=eq)  # Returns true if any item in a list of booleans is true.
flatten_2 = List.Flatten(list=anyTrue@L2)
filterByBoolMask = List.FilterByBoolMask(list=flatten, mask=flatten_2)
flatten_3 = List.Flatten(list=filterByBoolMask.out)
as_polycurve_bycurves = Custom[AS.[&] PolyCurve.ByCurves](VARcurves=flatten_3)  # Create polycurves from an unordered list of curves.
code_block_4 = CodeBlock { 2; }
chop = List.Chop(list=as_polycurve_bycurves.VARpolyCurve, lengths=code_block_4)
length = Curve.Length(curve=chop)
minimumItem = List.MinimumItem(list=length)
eq_2 = length == minimumItem
filterByBoolMask_2 = List.FilterByBoolMask(list=chop, mask=eq_2)
code_block_5 = CodeBlock { 1; }
getItemAtIndex = List.GetItemAtIndex(list=filterByBoolMask_2.in@L2, index=code_block_5)
isNull = Object.IsNull(obj=getItemAtIndex)
filterByBoolMask_3 = List.FilterByBoolMask(list=filterByBoolMask_2.out, mask=isNull)
filterByBoolMask_4 = List.FilterByBoolMask(list=getItemAtIndex, mask=isNull)
mergeByBoolMask = Custom[SP.List.MergeByBoolMask](VARIn=filterByBoolMask_3.in, VAROut=filterByBoolMask_4.out, VARmask=isNull)  # Merge two lists by a boolean mask list. The true count in the mask should be the same as the length of the true list and vice versa for the false list.
flatten_4 = List.Flatten(list=mergeByBoolMask)
firstItem = List.FirstItem(list=filterByBoolMask_2.in@L2)
curves = PolyCurve.Curves(polyCurve=firstItem)
code_block_6 = CodeBlock { 0; 1; }
length_2 = Curve.Length(curve=curves)
VARDistanceBetweenArrows = Input(VARDistanceBetweenArrows: var[]..[])
div = length_2 / VARDistanceBetweenArrows
ceiling = Math.Ceiling(number=div)
sequence = Sequence(start=code_block_6.out0, amount=ceiling, lacing=Longest)
remapRange = Math.RemapRange(numbers=sequence, newMin=code_block_6.out0, newMax=code_block_6.out1)
pointAtParameter_2 = Curve.PointAtParameter(curve=curves, param=remapRange)
closestPointTo = Geometry.ClosestPointTo(geometry=flatten_4, other=pointAtParameter_2)
flatten_5 = List.Flatten(list=closestPointTo@L2)
byStartPointEndPoint = Line.ByStartPointEndPoint(startPoint=pointAtParameter_2, endPoint=closestPointTo)
flatten_6 = List.Flatten(list=byStartPointEndPoint@L2)
byStartPointEndPoint_2 = Line.ByStartPointEndPoint(startPoint=pointAtParameter_2, endPoint=closestPointTo)
code_block_7 = CodeBlock { 0.5; }
pointAtParameter_3 = Curve.PointAtParameter(curve=byStartPointEndPoint_2, param=code_block_7)
byPoints = PolyCurve.ByPoints(points=pointAtParameter_3)
as_polycurve_bycurves_2 = Custom[AS.[&] PolyCurve.ByCurves](VARcurves=byPoints)
flatten_7 = List.Flatten(list=as_polycurve_bycurves_2.VARpolyCurve)
closestPointTo_2 = Geometry.ClosestPointTo(geometry=flatten_6, other=flatten_7, lacing=Longest)
flatten_8 = List.Flatten(list=closestPointTo_2@L2)
VARFlipDirection = Input(VARFlipDirection: var[]..[])
code_block_8 = CodeBlock { 1; -1; }
scopeIf = Custom[CW.ScopeIf+](VARtest=VARFlipDirection, VARtrue=code_block_8.out0, VARfalse=code_block_8.out1)  # A (hopefully) more robust implementation of ScopeIf. Tests a single boolean and returns a value accordingly.
shiftIndices = List.ShiftIndices(list=flatten_8@L2, amount=scopeIf)
flatten_9 = List.Flatten(list=pointAtParameter_2@L2)
laceShortest = List.LaceShortest(comb=create, list1=flatten_5, list2=shiftIndices, list3=flatten_9)
count = List.Count(list=closestPointTo_2@L3)
chop_2 = List.Chop(list=laceShortest, lengths=count)
transpose = List.Transpose(lists=chop_2@@L3)
code_block_9 = CodeBlock { true; }
byPoints_2 = PolyCurve.ByPoints(points=transpose@@L2, connectLastToFirst=code_block_9)
dropItems = List.DropItems(list=byPoints_2@@L2, amount=scopeIf)
curves_2 = PolyCurve.Curves(polyCurve=dropItems)
code_block_10 = CodeBlock { 0; 1; 2; }
sequence_2 = Sequence(amount=code_block_10.out2, lacing=Longest)
remapRange_2 = Math.RemapRange(numbers=sequence_2, newMin=code_block_10.out0, newMax=code_block_10.out1)
count_2 = List.Count(list=curves_2@@L2)
ofRepeatedItem = List.OfRepeatedItem(item=remapRange_2, amount=count_2)
pointAtParameter_4 = Curve.PointAtParameter(curve=curves_2, param=ofRepeatedItem)
flatten_10 = List.Flatten(list=pointAtParameter_4@@L3)
pruneDuplicates = Point.PruneDuplicates(points=flatten_10@@L2)
code_block_11 = CodeBlock { true; }
byPoints_3 = PolyCurve.ByPoints(points=pruneDuplicates, connectLastToFirst=code_block_11)
curves_3 = PolyCurve.Curves(polyCurve=byPoints_3)
hot_get_revit_activeview = Custom[HOT.Get Revit ActiveView]()  # Active View
turnIntoList = Custom[CW.TurnIntoList](VARunknownItem=hot_get_revit_activeview)  # Turns an element (or a nested list) into a flat list
get_view_range_settings = Custom[Get View Range Settings](VARViews=turnIntoList)  # Get View Range Settings
code_block_12 = CodeBlock(a=get_view_range_settings, b=get_view_range_settings) { a[0]; b[3]; }
plane = Custom[CW.Level.Plane](VARlevel=code_block_12.out0)  # Retrieves the plane of a given level
unit_types = UnitTypes("Length")
displayUnitType = Custom[CW.UnitType.DisplayUnitType](VARunitType=unit_types)  # Retrieves the display unit type for a given unit type.
toDisplayUnit = Custom[CW.InternalUnit.ToDisplayUnit](VARval=code_block_12.out1, VARdisplayUnitType=displayUnitType.VARdisplayUnitType)  # Converts a value from Revit's internal unit to a given display unit
offset = Plane.Offset(plane=plane, dist=toDisplayUnit)
code_block_13 = CodeBlock(a=offset) { a[0]; }
intersect = Geometry.Intersect(geometry=curves_3, other=code_block_13)
parameterAtPoint = Curve.ParameterAtPoint(curve=curves_3, point=intersect)
splitByParameter = Curve.SplitByParameter(curve=curves_3, parameters=parameterAtPoint)
isNull_2 = Object.IsNull()  # unwired: obj
replaceByCondition = Replace(item=splitByParameter, replaceWith=curves_3, condition=isNull_2)
flatten_11 = List.Flatten(list=replaceByCondition)
byOriginNormal = Plane.ByOriginNormal()
pullOntoPlane = Curve.PullOntoPlane(curve=flatten_11, plane=byOriginNormal)
code_block_14 = CodeBlock { 0.5; }
pointAtParameter_5 = Curve.PointAtParameter(curve=flatten_11, param=code_block_14)
closestPointTo_3 = Geometry.ClosestPointTo(geometry=code_block_13, other=pointAtParameter_5)
byTwoPoints = Vector.ByTwoPoints(start=closestPointTo_3, end=pointAtParameter_5)
normalized = Vector.Normalized(vector=byTwoPoints)
Z_2 = Vector.Z(vector=normalized)
code_block_15 = CodeBlock { 1; }
eq_3 = Z_2 == code_block_15
filterByBoolMask_5 = List.FilterByBoolMask(list=pullOntoPlane, mask=eq_3)
watch = Watch(flatten)
intersect_2 = Geometry.Intersect(geometry=watch, other=code_block_13)
parameterAtPoint_2 = Curve.ParameterAtPoint(curve=watch, point=intersect_2)
splitByParameter_2 = Curve.SplitByParameter(curve=watch, parameters=parameterAtPoint_2)
replaceByCondition_2 = Replace(item=splitByParameter_2, replaceWith=watch, condition=isNull_2)
flatten_12 = List.Flatten(list=replaceByCondition_2)
byOriginNormal_2 = Plane.ByOriginNormal()
pullOntoPlane_2 = Curve.PullOntoPlane(curve=flatten_12, plane=byOriginNormal_2)
startPoint = Curve.StartPoint(curve=pullOntoPlane_2)
code_block_16 = CodeBlock { 0.5; }
pointAtParameter_6 = Curve.PointAtParameter(curve=pullOntoPlane_2, param=code_block_16)
endPoint = Curve.EndPoint(curve=pullOntoPlane_2)
byThreePoints = Arc.ByThreePoints(firstPoint=startPoint, secondPoint=pointAtParameter_6, thirdPoint=endPoint)
isNull_3 = Object.IsNull(obj=byThreePoints)
filterByBoolMask_6 = List.FilterByBoolMask(list=pullOntoPlane_2, mask=isNull_3)
startPoint_2 = Curve.StartPoint(curve=filterByBoolMask_6.in)
endPoint_2 = Curve.EndPoint(curve=filterByBoolMask_6.in)
byStartPointEndPoint_3 = Line.ByStartPointEndPoint(startPoint=startPoint_2, endPoint=endPoint_2)
filterByBoolMask_7 = List.FilterByBoolMask(list=byThreePoints, mask=isNull_3)
mergeByBoolMask_2 = Custom[SP.List.MergeByBoolMask](VARIn=byStartPointEndPoint_3, VAROut=filterByBoolMask_7.out, VARmask=isNull_3)
pointAtParameter_7 = Curve.PointAtParameter(curve=flatten_12, param=code_block_14)
closestPointTo_4 = Geometry.ClosestPointTo(geometry=code_block_13, other=pointAtParameter_7)
byTwoPoints_2 = Vector.ByTwoPoints(start=closestPointTo_4, end=pointAtParameter_7)
normalized_2 = Vector.Normalized(vector=byTwoPoints_2)
Z_3 = Vector.Z(vector=normalized_2)
code_block_17 = CodeBlock { 1; }
eq_4 = Z_3 == code_block_17
filterByBoolMask_8 = List.FilterByBoolMask(list=mergeByBoolMask_2, mask=eq_4)
create_2 = List.Create(item0=filterByBoolMask_5.in, item1=filterByBoolMask_8.in)
code_block_18 = CodeBlock { false; }
clean = List.Clean(list=create_2, preserveIndices=code_block_18)
flatten_13 = List.Flatten(list=clean)
byOriginNormal_3 = Plane.ByOriginNormal()
pullOntoPlane_3 = Curve.PullOntoPlane(curve=flatten_13, plane=byOriginNormal_3)
fromCurve = Custom[CW.DetailLine.FromCurve](VARcurve=pullOntoPlane_3, VARview=hot_get_revit_activeview)  # Creates a detail line based on a given curve
code_block_19 = CodeBlock { "Line Style"; }
element_types = ElementTypes("GraphicsStyle")
all_elements_of_type = ElementsOfType(element_type=element_types)
name = Element.Name(element=all_elements_of_type)
VARAboveCutPlaneLinestyle = Input(VARAboveCutPlaneLinestyle: var[]..[])
eq_5 = name == VARAboveCutPlaneLinestyle
filterByBoolMask_9 = List.FilterByBoolMask(list=all_elements_of_type, mask=eq_5)
firstItem_2 = List.FirstItem(list=filterByBoolMask_9.in)
setParameterByName = Element.SetParameterByName(element=fromCurve, parameterName=code_block_19, value=firstItem_2)
filterByBoolMask_10 = List.FilterByBoolMask(list=flatten_11, mask=eq_3)
flatten_14 = List.Flatten(list=filterByBoolMask_10.out)
code_block_20 = CodeBlock(a=get_view_range_settings) { a[5]; }
offset_2 = Plane.Offset(plane=plane, dist=code_block_20)
code_block_21 = CodeBlock(a=offset_2) { a[0]; }
intersect_3 = Geometry.Intersect(geometry=flatten_14, other=code_block_21)
parameterAtPoint_3 = Curve.ParameterAtPoint(curve=flatten_14, point=intersect_3)
splitByParameter_3 = Curve.SplitByParameter(curve=flatten_14, parameters=parameterAtPoint_3)
isNull_4 = Object.IsNull()  # unwired: obj
replaceByCondition_3 = Replace(item=splitByParameter_3, replaceWith=flatten_14, condition=isNull_4)
flatten_15 = List.Flatten(list=replaceByCondition_3)
pullOntoPlane_4 = Curve.PullOntoPlane(curve=flatten_15, plane=byOriginNormal)
code_block_22 = CodeBlock { 0.5; }
pointAtParameter_8 = Curve.PointAtParameter(curve=flatten_15, param=code_block_22)
closestPointTo_5 = Geometry.ClosestPointTo(geometry=code_block_21, other=pointAtParameter_8)
XYZ = Custom[LF.Point.XYZ](VARpoint=pointAtParameter_8)  # Get the X, Y, and Z components of a Point
code_block_23 = CodeBlock { 0.01; }
add = XYZ.VARZ + code_block_23
byCoordinates_2 = Point.ByCoordinates(x=XYZ.VARX, y=XYZ.VARY, z=add)
byTwoPoints_3 = Vector.ByTwoPoints(start=closestPointTo_5, end=byCoordinates_2)
normalized_3 = Vector.Normalized(vector=byTwoPoints_3)
Z_4 = Vector.Z(vector=normalized_3)
code_block_24 = CodeBlock { 1; }
eq_6 = Z_4 == code_block_24
filterByBoolMask_11 = List.FilterByBoolMask(list=pullOntoPlane_4, mask=eq_6)
flatten_16 = List.Flatten(list=filterByBoolMask_11.in)
filterByBoolMask_12 = List.FilterByBoolMask(list=flatten_12, mask=eq_4)
flatten_17 = List.Flatten(list=filterByBoolMask_12.out)
intersect_4 = Geometry.Intersect(geometry=flatten_17, other=code_block_21)
parameterAtPoint_4 = Curve.ParameterAtPoint(curve=flatten_17, point=intersect_4)
splitByParameter_4 = Curve.SplitByParameter(curve=flatten_17, parameters=parameterAtPoint_4)
isNull_5 = Object.IsNull()  # unwired: obj
replaceByCondition_4 = Replace(item=splitByParameter_4, replaceWith=flatten_17, condition=isNull_5)
flatten_18 = List.Flatten(list=replaceByCondition_4)
byOriginNormal_4 = Plane.ByOriginNormal()
pullOntoPlane_5 = Curve.PullOntoPlane(curve=flatten_18, plane=byOriginNormal_4)
startPoint_3 = Curve.StartPoint(curve=pullOntoPlane_5)
code_block_25 = CodeBlock { 0.5; }
pointAtParameter_9 = Curve.PointAtParameter(curve=pullOntoPlane_5, param=code_block_25)
endPoint_3 = Curve.EndPoint(curve=pullOntoPlane_5)
byThreePoints_2 = Arc.ByThreePoints(firstPoint=startPoint_3, secondPoint=pointAtParameter_9, thirdPoint=endPoint_3)
isNull_6 = Object.IsNull(obj=byThreePoints_2)
filterByBoolMask_13 = List.FilterByBoolMask(list=pullOntoPlane_5, mask=isNull_6)
startPoint_4 = Curve.StartPoint(curve=filterByBoolMask_13.in)
endPoint_4 = Curve.EndPoint(curve=filterByBoolMask_13.in)
byStartPointEndPoint_4 = Line.ByStartPointEndPoint(startPoint=startPoint_4, endPoint=endPoint_4)
filterByBoolMask_14 = List.FilterByBoolMask(list=byThreePoints_2, mask=isNull_6)
model_curve_build_checker = Custom[Model Curve Build Checker](VARCurves=filterByBoolMask_14.out)  # Model Curve Build Checker
mergeByBoolMask_3 = Custom[SP.List.MergeByBoolMask](VARIn=byStartPointEndPoint_4, VAROut=model_curve_build_checker, VARmask=isNull_6)
code_block_26 = CodeBlock { 0.5; }
pointAtParameter_10 = Curve.PointAtParameter(curve=flatten_18, param=code_block_26)
closestPointTo_6 = Geometry.ClosestPointTo(geometry=code_block_21, other=pointAtParameter_10)
XYZ_2 = Custom[LF.Point.XYZ](VARpoint=pointAtParameter_10)
code_block_27 = CodeBlock { 0.01; }
add_2 = XYZ_2.VARZ + code_block_27
byCoordinates_3 = Point.ByCoordinates(x=XYZ_2.VARX, y=XYZ_2.VARY, z=add_2)
byTwoPoints_4 = Vector.ByTwoPoints(start=closestPointTo_6, end=byCoordinates_3)
normalized_4 = Vector.Normalized(vector=byTwoPoints_4)
Z_5 = Vector.Z(vector=normalized_4)
code_block_28 = CodeBlock { 1; }
eq_7 = Z_5 == code_block_28
filterByBoolMask_15 = List.FilterByBoolMask(list=mergeByBoolMask_3, mask=eq_7)
flatten_19 = List.Flatten(list=filterByBoolMask_15.in)
create_3 = List.Create(item0=flatten_16, item1=flatten_19)
clean_2 = List.Clean(list=create_3, preserveIndices=code_block_18)
flatten_20 = List.Flatten(list=clean_2)
byOriginNormal_5 = Plane.ByOriginNormal()
pullOntoPlane_6 = Curve.PullOntoPlane(curve=flatten_20, plane=byOriginNormal_5)
fromCurve_2 = Custom[CW.DetailLine.FromCurve](VARcurve=pullOntoPlane_6, VARview=hot_get_revit_activeview)
code_block_29 = CodeBlock { "Line Style"; }
VARWithinCutPlaneLinestyle = Input(VARWithinCutPlaneLinestyle: var[]..[])
eq_8 = name == VARWithinCutPlaneLinestyle
filterByBoolMask_16 = List.FilterByBoolMask(list=all_elements_of_type, mask=eq_8)
firstItem_3 = List.FirstItem(list=filterByBoolMask_16.in)
setParameterByName_2 = Element.SetParameterByName(element=fromCurve_2, parameterName=code_block_29, value=firstItem_3)
flatten_21 = List.Flatten(list=filterByBoolMask_15.out)
flatten_22 = List.Flatten(list=filterByBoolMask_11.out)
create_4 = List.Create(item0=flatten_21, item1=flatten_22)
clean_3 = List.Clean(list=create_4, preserveIndices=code_block_18)
flatten_23 = List.Flatten(list=clean_3)
byOriginNormal_6 = Plane.ByOriginNormal()
pullOntoPlane_7 = Curve.PullOntoPlane(curve=flatten_23, plane=byOriginNormal_6)
fromCurve_3 = Custom[CW.DetailLine.FromCurve](VARcurve=pullOntoPlane_7, VARview=hot_get_revit_activeview)
code_block_30 = CodeBlock { "Line Style"; }
VARUnderCutPlaneLinestyle = Input(VARUnderCutPlaneLinestyle: var[]..[])
eq_9 = name == VARUnderCutPlaneLinestyle
filterByBoolMask_17 = List.FilterByBoolMask(list=all_elements_of_type, mask=eq_9)
firstItem_4 = List.FirstItem(list=filterByBoolMask_17.in)
setParameterByName_3 = Element.SetParameterByName(element=fromCurve_3, parameterName=code_block_30, value=firstItem_4)
create_5 = List.Create(item0=fromCurve_2, item1=fromCurve, item2=fromCurve_3)
code_block_31 = CodeBlock { false; }
clean_4 = List.Clean(list=create_5, preserveIndices=code_block_31)
flatten_24 = List.Flatten(list=clean_4)
VARDetailCurves = Output(flatten_24)
