# Dynamo custom node Ramps Faces By SAT File.dyf (Dynamo 2.1.0.7500)
# category: Synthesize.Automate.Surface
# Ramps Faces By SAT File

VARSATFile = Input(VARSATFile: var[]..[])
better_geometry_importfromsat = Custom[Better Geometry.ImportFromSAT](VARSATFile=VARSATFile)  # Better Geometry.ImportFromSAT
explode = Geometry.Explode(geometry=better_geometry_importfromsat)
filterByOrientation = Custom[CW.Surface.FilterByOrientation](VARsurfaces=explode)  # Sorts surfaces in three lists based on their orientation (vertical, horizontal up & horizontal down) and also returns three corresponding lists of booleans.
removeListFromList = Custom[RH.RemoveListFromList](VARListA=explode@L2, VARListB=filterByOrientation.VARvertical@L2)  # This node essentially "subtracts" the contents of List B from List A to produce a new list with the unique items.
code_block = CodeBlock { false; }
clean = List.Clean(list=removeListFromList, preserveIndices=code_block)
code_block_2 = CodeBlock { 0.5; }
pointAtParameter = Surface.PointAtParameter(surface=clean@L2, u=code_block_2, v=code_block_2)
X = Point.X(point=pointAtParameter)
code_block_3 = CodeBlock { 3; }
round = Math.Round(number=X, digits=code_block_3)
Y = Point.Y(point=pointAtParameter)
round_2 = Math.Round(number=Y, digits=code_block_3)
join = List.Join(list0=round, list1=round_2)
transpose = List.Transpose(lists=join)
code_block_4 = CodeBlock { false; }
clean_2 = List.Clean(list=transpose, preserveIndices=code_block_4)
count = List.Count(list=pointAtParameter@L2)
chop = List.Chop(list=clean_2, lengths=count)
sum = Math.Sum(values=chop)
as_list_groupbykey = Custom[AS.[&] List.GroupByKey](VARobjectList=clean@L2, VARkeys=sum@L2)  # Sort the items of a list into groups (sublists) based on the corresponding items of a reference list. Example: The list {A,B,C,D,E} with the reference list {1,anyWord,4,anyWord,1} will be grouped into lists as { {A,E}, {B,D}, {C} } and the unique references will be {1, anyWord, 4}.
as_list_groupbykey_2 = Custom[AS.[&] List.GroupByKey](VARobjectList=pointAtParameter@L2, VARkeys=sum@L2)
Z = Point.Z(point=as_list_groupbykey_2.VARgroups)
maximumItem = List.MaximumItem(list=Z)
eq = maximumItem == Z
filterByBoolMask = List.FilterByBoolMask(list=as_list_groupbykey.VARgroups, mask=eq)
flatten = List.Flatten(list=filterByBoolMask.in)
area = Surface.Area(surface=flatten)
VARFacesArea = Input(VARFacesArea: var[]..[])
lt = area < VARFacesArea
filterByBoolMask_2 = List.FilterByBoolMask(list=flatten, mask=lt)
VARSurfaces = Output(filterByBoolMask_2.out)
