# Dynamo custom node Randomize Material Parameters.dyf (Dynamo 2.1.0.7500)
# category: Synthesize.Automate.Parameter
# Randomize Material Parameters

VARIsTypeParameters = Input(VARIsTypeParameters: var[]..[])
VARElementstoWorkon = Input(VARElementstoWorkon: var[]..[])
flatten = List.Flatten(list=VARElementstoWorkon)
type = FamilyInstance.Type(familyInstance=flatten)
uniqueItems = List.UniqueItems(list=type)
scopeIf = Custom[CW.ScopeIf+](VARtest=VARIsTypeParameters, VARtrue=uniqueItems, VARfalse=flatten)  # A (hopefully) more robust implementation of ScopeIf. Tests a single boolean and returns a value accordingly.
count = List.Count(list=scopeIf)
VARNumberofElements = Output(count)
VARElementstoselect = Output(scopeIf)
turnIntoList = Custom[CW.TurnIntoList](VARunknownItem=scopeIf)  # Turns an element (or a nested list) into a flat list
flatten_2 = List.Flatten(list=turnIntoList)
VARMaterialstoRandomizeSeperatebySymbol = Input(VARMaterialstoRandomizeSeperatebySymbol: var[]..[])
VARSeparationSymbol = Input(VARSeparationSymbol: var[]..[])
split = String.Split(str=VARMaterialstoRandomizeSeperatebySymbol, separator0=VARSeparationSymbol)
trimWhitespace = String.TrimWhitespace(str=split)
byName = Material.ByName(name=trimWhitespace)
VARListofParameterstoRandomize = Input(VARListofParameterstoRandomize: var[]..[])
uniqueItems_2 = List.UniqueItems(list=VARListofParameterstoRandomize)
python_script = Python(IN[0]=flatten_2, IN[1]=byName, IN[2]=uniqueItems_2)
# ---------- python_script.python (79 lines) ----------
# Enable Python support and load DesignScript library
# IMPORTANT : ALL DYNAMO DESIGN SCRIPT NODES ARE AS (dg)
import clr
clr.AddReference('ProtoGeometry')
from Autodesk.DesignScript import Geometry as dg

# EXTENSION Enable ToDSType
clr.AddReference('RevitNodes')
import Revit
clr.ImportExtensions(Revit.Elements)

# Enable Revit Elements
from Revit.Elements import *

# EXTENSION Enable Geometry Conversion Methods
clr.ImportExtensions(Revit.GeometryConversion)

# Enable Revit API
clr.AddReference('RevitAPI')
from Autodesk.Revit.DB import *

# Enable DocumentManager and TransactionManager
clr.AddReference('RevitServices')
from RevitServices.Persistence import DocumentManager
from RevitServices.Transactions import TransactionManager

# Enable ICollection List Translate
clr.AddReference("System")
import System.Collections.Generic
from System.Collections.Generic import List

import sys
sys.path.append(r'C:\Program Files (x86)\IronPython 2.7\DLLs')
sys.path.append(r'C:\Program Files (x86)\IronPython 2.7\Lib')

import random

def tolist(obj1):
	if hasattr(obj1,'__iter__'): return obj1
	else: return [obj1]
	
dataEnteringNode = IN
# Use UnwrapElement(IN[0]) When Translating From Dynamo to Revit
elems=UnwrapElement(tolist(IN[0]))
mats=UnwrapElement(tolist(IN[1]))
params=UnwrapElement(tolist(IN[2]))

loweredparams = []
for p in params:
	loweredparams.append(p.lower())
	
# Choose The Current Document
doc = DocumentManager.Instance.CurrentDBDocument
uidoc = DocumentManager.Instance.CurrentUIApplication.ActiveUIDocument
uiapp = DocumentManager.Instance.CurrentUIApplication
app = uiapp.Application

# Create Empty List
result = []
# Start a Transaction with Current Document (doc)
TransactionManager.Instance.EnsureInTransaction(doc)

for each in elems:
	eachparams = each.GetOrderedParameters()
	for e in eachparams:
		ptype = e.Definition.ParameterType
		pname = e.Definition.Name.lower()
		if ptype.ToString() == "Material" and pname in loweredparams:
			try:
				choice = random.choice(mats)
				result.append(e.Set(choice.Id))
			except:
				result.append(False)

# End the Transaction with Current Document ()
TransactionManager.Instance.TransactionTaskDone()

# Assign your output to the OUT variable.
OUT = result
# ----------------------------------------
