# Dynamo custom node ReFusion IT Export.dyf (Dynamo 2.1.0.7500)
# category: Synthesize.Fusion360
# This Node exports the fixed Geometry to a SAT file with Sufix (LinkMeToRevit) (Karam Baki)

VARGeometry = Input(VARGeometry: var[]..[])
VARFusionSATFilePath = Input(VARFusionSATFilePath: var[]..[])
string = StringInput(".sat")  # graph input
string_2 = StringInput("LinkMeToRevit.sat")  # graph input
replace = String.Replace(str=VARFusionSATFilePath, searchFor=string, replaceWith=string_2)
exportToSAT = Geometry.ExportToSAT(geometry=VARGeometry, filePath=replace)
VARPathofFixedSATFile = Output(exportToSAT)
