# Dynamo custom node ReLoft Faces.dyf (Dynamo 2.1.0.7500)
# category: Synthesize.Automate.Surface
# Balance Faces

VARBalanceOrNot = Input(VARBalanceOrNot: var[]..[])
VARSurfaces = Input(VARSurfaces: var[]..[])
empty = List.Empty()
scopeIf = Custom[CW.ScopeIf+](VARtest=VARBalanceOrNot, VARtrue=VARSurfaces, VARfalse=empty)  # A (hopefully) more robust implementation of ScopeIf. Tests a single boolean and returns a value accordingly.
perimeterCurves = Surface.PerimeterCurves(surface=scopeIf)
isNull = Object.IsNull(obj=perimeterCurves)
anyTrue = Custom[CW.List.AnyTrue](VARseq=isNull)  # Returns true if any item in a list of booleans is true.
filterByBoolMask = List.FilterByBoolMask(list=scopeIf, mask=anyTrue)
VARFlipBalancingDirection = Input(VARFlipBalancingDirection: var[]..[])
code_block = CodeBlock { 0; 1; }
scopeIf_2 = Custom[CW.ScopeIf+](VARtest=VARFlipBalancingDirection, VARtrue=code_block.out1, VARfalse=code_block.out0)
byIsoCurveOnSurface = Curve.ByIsoCurveOnSurface(baseSurface=filterByBoolMask.out, direction=scopeIf_2)
code_block_2 = CodeBlock { 1; }
byIsoCurveOnSurface_2 = Curve.ByIsoCurveOnSurface(baseSurface=filterByBoolMask.out, direction=scopeIf_2, parameter=code_block_2)
length = Curve.Length(curve=byIsoCurveOnSurface_2)
VARDistancing = Input(VARDistancing: var[]..[])
div = length / VARDistancing
round = Math.Round(number=div)
code_block_3 = CodeBlock { 10; }
lt = _ < code_block_3  # unwired: x
replaceByCondition = Replace(item=round, replaceWith=code_block_3, condition=lt)
python_script = Python(IN[0]=byIsoCurveOnSurface, IN[1]=replaceByCondition)
# ---------- python_script.python (58 lines) ----------
# Enable Python support and load DesignScript library
# IMPORTANT : ALL DYNAMO DESIGN SCRIPT NODES ARE AS (dg)
import clr
clr.AddReference('ProtoGeometry')
from Autodesk.DesignScript import Geometry as dg

# EXTENSION Enable ToDSType
clr.AddReference('RevitNodes')
import Revit
clr.ImportExtensions(Revit.Elements)

# Enable Revit Elements
from Revit.Elements import *

# EXTENSION Enable Geometry Conversion Methods
clr.ImportExtensions(Revit.GeometryConversion)

# Enable Revit API
clr.AddReference('RevitAPI')
from Autodesk.Revit.DB import *

# Enable DocumentManager and TransactionManager
clr.AddReference('RevitServices')
from RevitServices.Persistence import DocumentManager
from RevitServices.Transactions import TransactionManager

# Enable ICollection List Translate
clr.AddReference("System")
import System.Collections.Generic
from System.Collections.Generic import List

dataEnteringNode = IN
# Use UnwrapElement(IN[0]) When Translating From Dynamo to Revit
curves=UnwrapElement(IN[0])
numbers=UnwrapElement(IN[1])
# Choose The Current Document
doc = DocumentManager.Instance.CurrentDBDocument
uidoc = DocumentManager.Instance.CurrentUIApplication.ActiveUIDocument
uiapp = DocumentManager.Instance.CurrentUIApplication
app = uiapp.Application

# Create Empty List
result = []

count = 0
for c in curves:
	stp = [c.StartPoint]
	ste = [c.EndPoint]
	midpoints = dg.Curve.PointsAtEqualSegmentLength(c,numbers[count])
	count += 1
	fixedmid = []
	for m in midpoints:
		fixedmid.append(m)
	allpts = stp + fixedmid + ste
	result.append(allpts)
	
# Assign your output to the OUT variable.
OUT = result
# ----------------------------------------
UVParameterAtPoint = Surface.UVParameterAtPoint(surface=filterByBoolMask.out, point=python_script)
python_script_2 = Python(IN[0]=byIsoCurveOnSurface_2, IN[1]=replaceByCondition)  # same code as python_script
UVParameterAtPoint_2 = Surface.UVParameterAtPoint(surface=filterByBoolMask.out, point=python_script_2)
byParameterLineOnSurface = Curve.ByParameterLineOnSurface(baseSurface=filterByBoolMask.out, startParams=UVParameterAtPoint, endParams=UVParameterAtPoint_2)
length_2 = Curve.Length(curve=byParameterLineOnSurface)
firstItem = List.FirstItem(list=length_2@@L2)
round_2 = Math.Round(number=firstItem)
replaceByCondition_2 = Replace(item=round_2, replaceWith=code_block_3, condition=lt)
python_script_3 = Python(IN[0]=byParameterLineOnSurface, IN[1]=replaceByCondition_2)
# ---------- python_script_3.python (61 lines) ----------
# Enable Python support and load DesignScript library
# IMPORTANT : ALL DYNAMO DESIGN SCRIPT NODES ARE AS (dg)
import clr
clr.AddReference('ProtoGeometry')
from Autodesk.DesignScript import Geometry as dg

# EXTENSION Enable ToDSType
clr.AddReference('RevitNodes')
import Revit
clr.ImportExtensions(Revit.Elements)

# Enable Revit Elements
from Revit.Elements import *

# EXTENSION Enable Geometry Conversion Methods
clr.ImportExtensions(Revit.GeometryConversion)

# Enable Revit API
clr.AddReference('RevitAPI')
from Autodesk.Revit.DB import *

# Enable DocumentManager and TransactionManager
clr.AddReference('RevitServices')
from RevitServices.Persistence import DocumentManager
from RevitServices.Transactions import TransactionManager

# Enable ICollection List Translate
clr.AddReference("System")
import System.Collections.Generic
from System.Collections.Generic import List

dataEnteringNode = IN
# Use UnwrapElement(IN[0]) When Translating From Dynamo to Revit
curveslist=UnwrapElement(IN[0])
numbers=UnwrapElement(IN[1])
# Choose The Current Document
doc = DocumentManager.Instance.CurrentDBDocument
uidoc = DocumentManager.Instance.CurrentUIApplication.ActiveUIDocument
uiapp = DocumentManager.Instance.CurrentUIApplication
app = uiapp.Application

# Create Empty List
result = []

mastercount = 0
for curves in curveslist:
	tmp = []
	for c in curves:
		stp = [c.StartPoint]
		ste = [c.EndPoint]
		midpoints = dg.Curve.PointsAtEqualSegmentLength(c,numbers[mastercount])
		fixedmid = []
		for m in midpoints:
			fixedmid.append(m)
		allpts = stp + fixedmid + ste
		tmp.append(allpts)
	mastercount += 1
	result.append(tmp)
	
# Assign your output to the OUT variable.
OUT = result
# ----------------------------------------
byPoints = NurbsSurface.ByPoints(points=python_script_3)
filterByBoolMask_2 = List.FilterByBoolMask(list=perimeterCurves, mask=anyTrue)
al_group_curves = Custom[AL.Group Curves](VARCurves=filterByBoolMask_2.out@L2)  # This node will take any input of flat list of curves and group them into sublists containing "joinable" curves that is continous curves. They might form closed curves or open curves. Use PolyCurve.ByJoinedCurves to convert output groups of curves into single PolyCurves
python_script_4 = Python(IN[0]=al_group_curves)
# ---------- python_script_4.python (55 lines) ----------
# Enable Python support and load DesignScript library
# IMPORTANT : ALL DYNAMO DESIGN SCRIPT NODES ARE AS (dg)
import clr
clr.AddReference('ProtoGeometry')
from Autodesk.DesignScript import Geometry as dg

# EXTENSION Enable ToDSType
clr.AddReference('RevitNodes')
import Revit
clr.ImportExtensions(Revit.Elements)

# Enable Revit Elements
from Revit.Elements import *

# EXTENSION Enable Geometry Conversion Methods
clr.ImportExtensions(Revit.GeometryConversion)

# Enable Revit API
clr.AddReference('RevitAPI')
from Autodesk.Revit.DB import *

# Enable DocumentManager and TransactionManager
clr.AddReference('RevitServices')
from RevitServices.Persistence import DocumentManager
from RevitServices.Transactions import TransactionManager

# Enable ICollection List Translate
clr.AddReference("System")
import System.Collections.Generic
from System.Collections.Generic import List

dataEnteringNode = IN
# Use UnwrapElement(IN[0]) When Translating From Dynamo to Revit
lists=UnwrapElement(IN[0])

# Choose The Current Document
doc = DocumentManager.Instance.CurrentDBDocument
uidoc = DocumentManager.Instance.CurrentUIApplication.ActiveUIDocument
uiapp = DocumentManager.Instance.CurrentUIApplication
app = uiapp.Application

# Create Empty List
result = []

for l in lists:
	tmp = []
	for l2 in l:
		try:
			tmp.append(dg.PolyCurve.ByJoinedCurves(l2,0.01))
		except:
			tmp.append(dg.PolyCurve.ByJoinedCurves(l2))
	result.append(tmp)

# Assign your output to the OUT variable.
OUT = result
# ----------------------------------------
trimWithEdgeLoops = Surface.TrimWithEdgeLoops(surface=byPoints, loops=python_script_4)
flipNormalDirection = Surface.FlipNormalDirection(surface=trimWithEdgeLoops)
python_script_5 = Python(IN[0]=flipNormalDirection, IN[1]=trimWithEdgeLoops)
# ---------- python_script_5.python (56 lines) ----------
# Enable Python support and load DesignScript library
# IMPORTANT : ALL DYNAMO DESIGN SCRIPT NODES ARE AS (dg)
import clr
clr.AddReference('ProtoGeometry')
from Autodesk.DesignScript import Geometry as dg

# EXTENSION Enable ToDSType
clr.AddReference('RevitNodes')
import Revit
clr.ImportExtensions(Revit.Elements)

# Enable Revit Elements
from Revit.Elements import *

# EXTENSION Enable Geometry Conversion Methods
clr.ImportExtensions(Revit.GeometryConversion)

# Enable Revit API
clr.AddReference('RevitAPI')
from Autodesk.Revit.DB import *

# Enable DocumentManager and TransactionManager
clr.AddReference('RevitServices')
from RevitServices.Persistence import DocumentManager
from RevitServices.Transactions import TransactionManager

# Enable ICollection List Translate
clr.AddReference("System")
import System.Collections.Generic
from System.Collections.Generic import List

dataEnteringNode = IN
# Use UnwrapElement(IN[0]) When Translating From Dynamo to Revit
faces1=UnwrapElement(IN[0])
faces2=UnwrapElement(IN[1])

# Choose The Current Document
doc = DocumentManager.Instance.CurrentDBDocument
uidoc = DocumentManager.Instance.CurrentUIApplication.ActiveUIDocument
uiapp = DocumentManager.Instance.CurrentUIApplication
app = uiapp.Application

# Create Empty List
result = []

counter = 0
for f in faces1:
	try:
		sub1 = dg.Surface.Difference(f,[faces2[counter]])
		result.append(dg.Surface.Difference(f,[sub1]))
	except:
		result.append(f)
	counter += 1

# Assign your output to the OUT variable.
OUT = result
# ----------------------------------------
scopeIf_3 = Custom[CW.ScopeIf+](VARtest=VARBalanceOrNot, VARtrue=python_script_5, VARfalse=VARSurfaces)
VARSurface = Output(scopeIf_3)
