# Dynamo custom node Recreate Surfaces.dyf (Dynamo 2.1.0.7500)
# category: Synthesize.Automate.Surface
# Recreate Surfaces

VARSurfaces = Input(VARSurfaces: var[]..[])
VARRevitCheck = Input(VARRevitCheck: bool = true)
VARForceRecreate = Input(VARForceRecreate: bool = false)
python_script = Python(IN[0]=VARSurfaces, IN[1]=VARRevitCheck, IN[2]=VARForceRecreate)
# ---------- python_script.python (406 lines) ----------
# Created By Karam Baki, karam@aecedx.com

import clr
import System

pf_path = System.Environment.GetFolderPath(System.Environment.SpecialFolder.ProgramFilesX86)
import sys
sys.path.append('%s\IronPython 2.7\Lib' %pf_path)
import traceback
import random
import string

clr.AddReference('ProtoGeometry')
from Autodesk.DesignScript.Geometry import *

clr.AddReference('RevitServices')
import RevitServices
from RevitServices.Persistence import DocumentManager
from RevitServices.Transactions import TransactionManager
doc = DocumentManager.Instance.CurrentDBDocument

clr.AddReference('RevitAPI')
from Autodesk.Revit.DB import *
from Autodesk.Revit.DB.Structure import StructuralType

from Autodesk.DesignScript import Geometry as dg

clr.AddReference('RevitNodes')
import Revit
clr.ImportExtensions(Revit.Elements)
clr.ImportExtensions(Revit.GeometryConversion)

import math

def recreatesurfaces(surfaces,RevitCheck=True,ForceRecreate=False,doc=DocumentManager.Instance.CurrentDBDocument,temp_path=System.IO.Path.GetTempPath()):
	class WarnSwallowImport(IFailuresPreprocessor):
		def PreprocessFailures(self, failuresAccessor):
			failuresAccessor.DeleteAllWarnings()
			return FailureProcessingResult.Continue
	def flatten(x):
	    result = []
	    for el in x:
	        if hasattr(el, "__iter__") and not isinstance(el, basestring):
	            result.extend(flatten(el))
	        else:
	            result.append(el)
	    return result
	
	def tolist(obj1):
		if hasattr(obj1,'__iter__'): return obj1
		else: return [obj1]
	def cleanupSurface(surface):
		def isActuallygood(geomorsat,converted):
			geometrymode = True
			originalfaces = []
			if isinstance(geomorsat,dg.Solid) or isinstance(geomorsat,dg.PolySurface):
				exploded = dg.Geometry.Explode(geomorsat)
				for exp in exploded:
					originalfaces.append(exp)
					if exp.Closed:
						originalfaces.append(exp)
			elif isinstance(geomorsat,dg.Surface):
				if geometrymode == False:
					originalfaces.append(geomorsat)
					if geomorsat.Closed:
						originalfaces.append(geomorsat)
				else:
					exploded = dg.Geometry.Explode(geomorsat)
					for exp in exploded:
						originalfaces.append(exp)
						if exp.Closed:
							originalfaces.append(exp)
			elif isinstance(geomorsat,str):
				geomsorsat = dg.Geometry.ImportFromSAT(geomorsat)
				for geomorsat in geomsorsat:
					if isinstance(geomorsat,dg.Solid) or isinstance(geomorsat,dg.PolySurface):
						exploded = dg.Geometry.Explode(geomorsat)
						for exp in exploded:
							originalfaces.append(exp)
							if exp.Closed:
								originalfaces.append(exp)
						if geometrymode == False and doc.IsFamilyDocument:
							geomorsat.Dispose()
					elif isinstance(geomorsat,dg.Surface):
						if geometrymode == False:
							originalfaces.append(geomorsat)
							if geomorsat.Closed:
								originalfaces.append(geomorsat)
						else:
							exploded = dg.Geometry.Explode(geomorsat)
							for exp in exploded:
								originalfaces.append(exp)
								if exp.Closed:
									originalfaces.append(exp)
				if geometrymode:
					geomorsat = list(geomsorsat)
			originalnum = len(originalfaces)
			for org in originalfaces:
				org.Dispose()
			FFfaces = []
			for e in converted:
				getfaces = e.Faces
				for gotten in getfaces:
					FFfaces.append(gotten)
			FFfacesnum = len(FFfaces)
			if FFfacesnum >= originalnum:
				samefaces = True
			else:
				samefaces = False
			return samefaces
		def checkcompatible(geoms,RevitCheck):
			if RevitCheck == False:
				return True
			randomname = ''.join([random.choice(string.ascii_letters + string.digits) for n in xrange(5)])
			sat_path = '%s%s.sat' % (temp_path, randomname)
			dg.Geometry.ExportToSAT(geoms,sat_path)
			converted = []
			shapeImporter = ShapeImporter()
			converted = list(shapeImporter.Convert(doc, sat_path))
			shapeImporter.Dispose()
			System.IO.File.Delete(sat_path)
			for e in converted:
				if e.ToString() == "Autodesk.Revit.DB.Mesh":
					return False
			if len(converted) != 0:
				converted = isActuallygood(geoms,converted)
			return converted
		def meternumber(value):
			value = value
			return value
		def metersurfarea(surface):
			area = meternumber(surface.Area)
			return area
		def almostsame(surf1,surf2,tollerance = 3):
			if round(metersurfarea(surf1),tollerance) == round(metersurfarea(surf2),tollerance):
				return True
			else:
				return False
		def subtractfunction(nurbs,cleanexplodes):
			def loopclean(nurbs,thick,counter):
				result = dg.Surface.SubtractFrom(nurbs,thick)[0]
				if counter != 0:
					nurbs.Dispose()
				thick.Dispose()
				return result
			thickforms = []
			for cleanex in cleanexplodes:
				safearea = metersurfarea(cleanex)/10
				if safearea > meternumber(0.1):
					maxthicken = meternumber(0.1)
				else:
					maxthicken = safearea
				thickforms.append(dg.Surface.Thicken(cleanex,maxthicken,True))
			counter = 0
			for thick in thickforms:
				nurbs = loopclean(nurbs,thick,counter)
				counter += 1
			return nurbs
		def tryingforall(surface,nurbs,cleanexplodes,geometrymode):
			try:
				finalsub = subtractfunction(nurbs,cleanexplodes)
				return [finalsub]
			except:
				try:
					finalsub = dg.Surface.Difference(nurbs,cleanexplodes)
					return [finalsub]
				except Exception as e:
					if str(e) == "Cannot difference an empty list" and almostsame(nurbs,surface):
						finalsub = nurbs
						try:
							return [finalsub]
						except:
							return None
		def gencleanexplodes(subtractnurbs):
			if isinstance(subtractnurbs, list):
				if len(subtractnurbs) == 0:
					return []
			else:
				explodednurbs = dg.Geometry.Explode(subtractnurbs)
				cleanexplodes = []
				if safemode:
					for ex in explodednurbs:
						if ex.Area < meternumber(0.002):
							ex.Dispose()
						else:
							cleanexplodes.append(ex)
				else:
					cleanexplodes = list(explodednurbs)
				subtractnurbs.Dispose()
				return cleanexplodes
		def easymethod(surface,geometrymode):
			try:
				nurbs = dg.Surface.ToNurbsSurface(surface)
				if almostsame(nurbs,surface):
					try:
						return True,[nurbs]
					except:
						return None,nurbs
				else:
					return None,nurbs
			except:
				return None,None
		def isplanarsurf(s):
			norms = [0,0.333,0.666,1]
			pts = []
			for n in norms:
				for n2 in norms:
					pts.append(dg.Surface.PointAtParameter(s,n,n2))
			plane = dg.Plane.ByBestFitThroughPoints(pts)
			status = True
			for p in pts:
				try:
					inter = dg.Geometry.DoesIntersect(p,plane)
					if inter == False:
						status = False
						break
				except:
					pass
			return status
		def joincurves(crvs):
			def PointsEqual(pt1, pt2):
				tolerance = 0.00001
				if (math.fabs(pt1.X - pt2.X) < tolerance and
					math.fabs(pt1.Y - pt2.Y) < tolerance and
					math.fabs(pt1.Z - pt2.Z) < tolerance):
					return True
				else:
					return False
			crvs = flatten(tolist(crvs))
			crvGroup = [-1 for x in range(len(crvs))]
			crvGroup[0] = 0
			maxGroupNum = 1
			starts = []
			ends = []
			for crv in crvs:
				starts.append(crv.PointAtParameter(0))
				ends.append(crv.PointAtParameter(1))
			for i in range(len(crvs)):
				if (crvGroup[i] == -1):
					crvGroup[i] = i
				for j in range(len(crvs)):
					if (i != j and
						(PointsEqual(starts[i], starts[j]) or
						PointsEqual(starts[i], ends[j]) or
						PointsEqual(ends[i], starts[j]) or
						PointsEqual(ends[i], ends[j]))):
						if (crvGroup[j] == -1):
							crvGroup[j] = crvGroup[i]
						elif (crvGroup[i] != crvGroup[j]):
							oldNum = crvGroup[j]
							for k in range(len(crvs)):
								if (crvGroup[k] == oldNum):
									crvGroup[k] = crvGroup[i]
			groups = []
			excluded = []
			for n in crvGroup:
				innercount = 0
				tmp = []
				for n2 in crvGroup:
					if n == n2 and n2 not in excluded:
						tmp.append(crvs[innercount])
					innercount += 1
				if len(tmp) == 0:
					continue
				try:
					tmp = dg.PolyCurve.ByJoinedCurves(tmp)
					groups.append(tmp)
				except:
					for t in tmp:
						groups.append(dg.PolyCurve.ByJoinedCurves([t]))
				excluded.append(n)
			joinedcurves = groups
			return joinedcurves
		def trimloopmethod(surface,nurbs,geometrymode):
			try:
				if surface.Closed:
					return None
				try:
					joinedperms = [dg.PolyCurve.ByJoinedCurves(surface.PerimeterCurves())]
				except:
					joinedperms = joincurves(surface.PerimeterCurves())
				finalsub = dg.Surface.TrimWithEdgeLoops(nurbs,joinedperms)
				if almostsame(finalsub,surface):
					return [finalsub]
				else:
					return None
			except:
				return None
		def thickenintersectMethod(surface,nurbs,geometrymode,pointOneMeter):
			try:
				tmp_thicken = dg.Surface.Thicken(surface,pointOneMeter,True)
				isplanar = isplanarsurf(surface)
				if isplanar:
					tmp_pt = dg.Surface.PointAtParameter(surface,0.5,0.5)
					tmp_norm = dg.Surface.NormalAtPoint(surface,tmp_pt)
					intersecter = dg.Plane.ByOriginNormal(tmp_pt,tmp_norm)
					finalsub = dg.Geometry.Intersect(intersecter,tmp_thicken)
					for f in finalsub:
						if isinstance(f,dg.Surface):
							finalsub = f
							break
					tmp_thicken.Dispose()
				else:
					finalsub = dg.Geometry.Intersect(nurbs,tmp_thicken)
					for f in finalsub:
						if isinstance(f,dg.Surface):
							finalsub = f
							break
					tmp_thicken.Dispose()
				return [finalsub]
			except:
				return None
		def inithickenMethod(surface,nurbs,geometrymode):
			try:
				safearea = metersurfarea(surface)/10
				if safearea > meternumber(0.1):
					maxthicken = meternumber(0.1)
				else:
					maxthicken = safearea
				thickeninit = dg.Surface.Thicken(surface,maxthicken,True)
				try:
					subtractnurbs = dg.Surface.SubtractFrom(nurbs,thickeninit)[0]
				except Exception as e:
					if "index out of range" in str(e) and almostsame(nurbs,surface):
						subtractnurbs = []
					elif "index out of range" in str(e):
						try:
							subtractnurbs = dg.Surface.Difference(nurbs,[surface])
						except Exception as e:
							if str(e) == "Unable to get FACE from BODY: no faces in BODY":
								subtractnurbs = []
				thickeninit.Dispose()
				cleanexplodes = gencleanexplodes(subtractnurbs)
				tryall = tryingforall(surface,nurbs,cleanexplodes,geometrymode)
				if tryall != None:
					return tryall
				else:
					return None
			except:
				return None
		def simplesubmethod(surface,nurbs,geometrymode):
			try:
				try:
					subtractnurbs = dg.Surface.Difference(nurbs,[surface])
				except Exception as e:
					if str(e) == "Unable to get FACE from BODY: no faces in BODY":
						try:
							return [nurbs]
						except:
							return None
				cleanexplodes = gencleanexplodes(subtractnurbs)
				tryall = tryingforall(surface,nurbs,cleanexplodes,geometrymode)
				if tryall != None:
					return tryall
				else:
					return None
			except:
				return None
		geometrymode = True
		safemode = False
		pointOneMeter = 0.1
		if ForceRecreate == False:
			if checkcompatible(surface,RevitCheck):
				return surface
		easy = easymethod(surface,geometrymode)
		if easy[0] != None:
			return easy[1][0]
		elif easy[0] == None and easy[1] == None:
			return surface
		else:
			nurbs = easy[1]
		trimloop = trimloopmethod(surface,nurbs,geometrymode)
		if trimloop != None:
			if checkcompatible(trimloop[0],RevitCheck):
				return trimloop[0]
		simple = simplesubmethod(surface,nurbs,geometrymode)
		if simple != None:
			if checkcompatible(simple[0],RevitCheck):
				return simple[0]
		inithick = inithickenMethod(surface,nurbs,geometrymode)
		if inithick != None:
			if checkcompatible(inithick[0],RevitCheck):
				return inithick[0]
		thickeninter = thickenintersectMethod(surface,nurbs,geometrymode,pointOneMeter)
		if thickeninter != None:
			if checkcompatible(thickeninter[0],RevitCheck):
				return thickeninter[0]
		return surface
	
	TransactionManager.Instance.ForceCloseTransaction()
	trans = Transaction(doc, 'Temporary Transaction')
	trans.Start()
	warnhandle = WarnSwallowImport()
	foptions = trans.GetFailureHandlingOptions()
	foptions.SetFailuresPreprocessor(warnhandle)
	foptions.SetClearAfterRollback(True)
	trans.SetFailureHandlingOptions(foptions)
	surfaces = flatten(tolist(surfaces))
	cleanedsurfs = []
	for s in surfaces:
		cleanedsurfs.append(cleanupSurface(s))
	surfaces = cleanedsurfs
	trans.RollBack()
	return surfaces

OUT = recreatesurfaces(IN[0],IN[1],IN[2])
# ----------------------------------------
VARSurfaces_2 = Output(python_script)  # "VARSurfaces"
