# Dynamo custom node Reference Point Orientation Fix By Coordinate System.dyf (Dynamo 2.1.0.7500)
# category: Synthesize.Automate.Point
# Reference Point By Coordinate System

VARCoordinateSystem = Input(VARCoordinateSystem: var[]..[])
VARReferencePoint = Input(VARReferencePoint: var[]..[])
python_script = Python(IN[0]=VARCoordinateSystem, IN[1]=VARReferencePoint)
# ---------- python_script.python (65 lines) ----------
# Created By Karam Baki : karam@aecedx.com
# Enable Python support and load DesignScript library
# IMPORTANT : ALL DYNAMO DESIGN SCRIPT NODES ARE AS (dg)
import clr
clr.AddReference('ProtoGeometry')
from Autodesk.DesignScript import Geometry as dg

# EXTENSION Enable ToDSType
clr.AddReference('RevitNodes')
import Revit
clr.ImportExtensions(Revit.Elements)

# Enable Revit Elements
from Revit.Elements import *

# EXTENSION Enable Geometry Conversion Methods
clr.ImportExtensions(Revit.GeometryConversion)

# Enable Revit API
clr.AddReference('RevitAPI')
from Autodesk.Revit.DB import *

# Enable DocumentManager and TransactionManager
clr.AddReference('RevitServices')
from RevitServices.Persistence import DocumentManager
from RevitServices.Transactions import TransactionManager

# Enable ICollection List Translate
clr.AddReference("System")
import System.Collections.Generic
from System.Collections.Generic import List

import sys
sys.path.append(r'C:\Program Files (x86)\IronPython 2.7\DLLs')
sys.path.append(r'C:\Program Files (x86)\IronPython 2.7\Lib')
from collections import Iterable

doc = DocumentManager.Instance.CurrentDBDocument
app = doc.Application

pcoor = UnwrapElement(IN[0])
refpoints = UnwrapElement(IN[1])

sketchplanes = []
Xvec = []
Pointslist = []
result = []

TransactionManager.Instance.EnsureInTransaction(doc)

for peachlist in pcoor:
	sketchplanes.append(SketchPlane.Create(doc, peachlist.XYPlane.ToPlane()).GetPlaneReference())
	Xvec.append(peachlist.XAxis.ToXyz())
	Pointslist.append(peachlist.Origin)

count1 = 0
for peach in sketchplanes:
	dynpoints = PointOnPlane.NewPointOnPlane(doc,peach,Pointslist[count1].ToXyz(),XYZ(Xvec[count1].X,Xvec[count1].Y,Xvec[count1].Z))
	refpoints[count1].SetPointElementReference(dynpoints)
	result.append(refpoints[count1])
	count1 = count1 + 1
	
TransactionManager.Instance.TransactionTaskDone()

OUT = result
# ----------------------------------------
VARReferencePoint_2 = Output(python_script)  # "VARReferencePoint"
