# Dynamo custom node Reference Point To Coordinate System.dyf (Dynamo 2.1.0.7500)
# category: Synthesize.Automate.Reference Point
# Reference Point To Coordinate System

VARReferencePoint = Input(VARReferencePoint: var[]..[])
python_script = Python(IN[0]=VARReferencePoint)
# ---------- python_script.python (54 lines) ----------
# Enable Python support and load DesignScript library
# IMPORTANT : ALL DYNAMO DESIGN SCRIPT NODES ARE AS (dg)
import clr
clr.AddReference('ProtoGeometry')
from Autodesk.DesignScript import Geometry as dg

# EXTENSION Enable ToDSType
clr.AddReference('RevitNodes')
import Revit
clr.ImportExtensions(Revit.Elements)

# Enable Revit Elements
from Revit.Elements import *

# EXTENSION Enable Geometry Conversion Methods
clr.ImportExtensions(Revit.GeometryConversion)

# Enable Revit API
clr.AddReference('RevitAPI')
from Autodesk.Revit.DB import *

# Enable DocumentManager and TransactionManager
clr.AddReference('RevitServices')
from RevitServices.Persistence import DocumentManager
from RevitServices.Transactions import TransactionManager

# Enable ICollection List Translate
clr.AddReference("System")
import System.Collections.Generic
from System.Collections.Generic import List

dataEnteringNode = IN
# Use UnwrapElement(IN[0]) When Translating From Dynamo to Revit
refs=UnwrapElement(IN[0])

# Choose The Current Document
doc = DocumentManager.Instance.CurrentDBDocument
uidoc = DocumentManager.Instance.CurrentUIApplication.ActiveUIDocument
uiapp = DocumentManager.Instance.CurrentUIApplication
app = uiapp.Application

# Create Empty List
result = []

# Start a Transaction with Current Document (doc)
TransactionManager.Instance.EnsureInTransaction(doc)
for each in refs:
	result.append(ReferencePoint.GetCoordinateSystem(each).ToCoordinateSystem())
# End the Transaction with Current Document ()
TransactionManager.Instance.TransactionTaskDone()


# Assign your output to the OUT variable.
OUT = result
# ----------------------------------------
VARCoordinateSystem = Output(python_script)
