# Dynamo custom node ReferencePlanesByModelElementsorAdaptiveFamily.dyf (Dynamo 2.1.0.7500)
# category: Synthesize.Automate.Reference Plane
# ReferencePlanesByModelElementsorAdaptiveFamily

VARelements = Input(VARelements: var[]..[])
turnIntoList = Custom[CW.TurnIntoList](VARunknownItem=VARelements)  # Turns an element (or a nested list) into a flat list
curves = Element.Curves(element=turnIntoList)
isEmpty = List.IsEmpty(list=curves, lacing=Longest)
filterByBoolMask = List.FilterByBoolMask(list=turnIntoList, mask=isEmpty)
geometry_and_vector_of_model = Custom[Geometry and Vector of Model Curves and Curve By Points](VARElements=filterByBoolMask.out)  # Geometry and Vector of Model Curves and Curve By Points
VARDetailLevelForAdaptiveFamilies = Input(VARDetailLevelForAdaptiveFamilies: var[]..[])
element_geometry_with_detail = Custom[Element.Geometry With Detail Level](VARElements=filterByBoolMask.in, VARDetailLevel=VARDetailLevelForAdaptiveFamilies)  # Element.Geometry With Detail Level
code_block = CodeBlock { false; }
clean = List.Clean(list=element_geometry_with_detail, preserveIndices=code_block)
flatten = List.Flatten(list=clean)
create = List.Create(item0=geometry_and_vector_of_model.VARCurves, item1=flatten)
code_block_2 = CodeBlock { false; }
clean_2 = List.Clean(list=create, preserveIndices=code_block_2)
flatten_2 = List.Flatten(list=clean_2)
startPoint = Curve.StartPoint(curve=element_geometry_with_detail)
endPoint = Curve.EndPoint(curve=element_geometry_with_detail)
create_2 = List.Create(item0=startPoint, item1=endPoint)
transpose = List.Transpose(lists=create_2)
flatten_3 = List.Flatten(list=transpose@L3)
byBestFitThroughPoints = Plane.ByBestFitThroughPoints(points=flatten_3)
python_script = Python(IN[0]=element_geometry_with_detail, IN[1]=byBestFitThroughPoints)
# ---------- python_script.python (24 lines) ----------
# Load the Python Standard and DesignScript Libraries
import sys
import clr
clr.AddReference('ProtoGeometry')
from Autodesk.DesignScript.Geometry import *

# The inputs to this node will be stored as a list in the IN variables.
dataEnteringNode = IN

list1 = IN[0]
list2 = IN[1]

matched = []
counter = 0
for l in list1:
	tmp = []
	for l2 in l:
		tmp.append(list2[counter])
	matched.append(tmp)
	counter += 1
# Place your code below this line

# Assign your output to the OUT variable.
OUT = matched
# ----------------------------------------
normal = Plane.Normal(plane=python_script)
clean_3 = List.Clean(list=normal, preserveIndices=code_block)
flatten_4 = List.Flatten(list=clean_3)
create_3 = List.Create(item0=geometry_and_vector_of_model.VARVectors, item1=flatten_4)
code_block_3 = CodeBlock { false; }
clean_4 = List.Clean(list=create_3, preserveIndices=code_block_3)
flatten_5 = List.Flatten(list=clean_4)
byLinesAndVectors = Custom[ReferencePlane.ByLinesAndVectors](VARLines=flatten_2, VARVectors=flatten_5)  # New Reference Plane By Lines and Vectors
VARReferencePlanes = Output(byLinesAndVectors)
