# Dynamo custom node Refine Families.dyf (Dynamo 2.1.0.7500)
# category: Synthesize.Automate.Family
# Refine Families

code_block = CodeBlock { false; }
VARElements = Input(VARElements: var[]..[])
code_block_2 = CodeBlock { "BuildingPad"; "Floor"; "Wall"; }
filterByString = Custom[ST.List.FilterByString](VARlist=VARElements, VARString=code_block_2.out0)  # Filter a list by a string match
byClassName = Custom[SP.Filter.ByClassName](VARobject=filterByString.VAROther, VARclassName=code_block_2.out1)  # Filters a list of objects by the object's class name. Note that Dynamo elements belong to different classes than their Revit counterparts. Use the Object.Class node to check an object's class.
create = List.Create(item0=filterByString.VARMatch, item1=byClassName.VARin)
code_block_3 = CodeBlock { false; }
clean = List.Clean(list=create, preserveIndices=code_block_3)
flatten = List.Flatten(list=clean)
code_block_4 = CodeBlock { "Level"; "Height Offset From Level"; }
categories = Categories("OST_Levels")
all_elements_of_category = ElementsOfCategory(Category=categories)
elementSketch = Custom[SP.Collector.ElementSketch](VARelement=flatten)  # Get the actual sketch lines of a sketch based element (floor, ceiling, modified wall, etc.) . You can optionally fetch the matching model curves, however this might prove comptationally heavy on larger data sets.
firstItem = List.FirstItem(list=elementSketch.VARcurves@L3)
firstItem_2 = List.FirstItem(list=firstItem@L2)
startPoint = Curve.StartPoint(curve=firstItem_2)
code_block_5 = CodeBlock { 1000; }
points_refine_levels_and_offset = Custom[Points Refine Levels and Offset](VARLevels=all_elements_of_category, VARPoints=startPoint, VARFixFactorDependsofProjectUnits1Formetersforexampleand100forCentimeters=code_block_5)  # Family Refine Levels and Offset
setParameterByName = Element.SetParameterByName(element=flatten, parameterName=code_block_4.out0, value=points_refine_levels_and_offset.VARLevelsSet)
byClassName_2 = Custom[SP.Filter.ByClassName](VARobject=byClassName.VARout, VARclassName=code_block_2.out2)
flatten_2 = List.Flatten(list=byClassName_2.VARin)
code_block_6 = CodeBlock { "Base Offset"; "Base Constraint"; }
boundingBox = Element.BoundingBox(element=flatten_2)
minPoint = BoundingBox.MinPoint(boundingBox=boundingBox)
points_refine_levels_and_offset_2 = Custom[Points Refine Levels and Offset](VARLevels=all_elements_of_category, VARPoints=minPoint, VARFixFactorDependsofProjectUnits1Formetersforexampleand100forCentimeters=code_block_5)
setParameterByName_2 = Element.SetParameterByName(element=flatten_2, parameterName=code_block_6.out0, value=points_refine_levels_and_offset_2.VARElevationsSet)
X = Point.X(point=minPoint)
Y = Point.Y(point=minPoint)
code_block_7 = CodeBlock { "Unconnected Height"; }
getParameterValueByName = Element.GetParameterValueByName(element=flatten_2, parameterName=code_block_7)
Z = Point.Z(point=minPoint)
code_block_8 = CodeBlock(a=getParameterValueByName, b=Z) { a+b; }
byCoordinates = Point.ByCoordinates(x=X, y=Y, z=code_block_8)
points_refine_levels_and_offset_3 = Custom[Points Refine Levels and Offset](VARLevels=all_elements_of_category, VARPoints=byCoordinates, VARFixFactorDependsofProjectUnits1Formetersforexampleand100forCentimeters=code_block_5)
SystemRefineWallTopConstraints = Input(SystemRefineWallTopConstraints: var[]..[])
python_script = Python(IN[0]=flatten_2, IN[1]=points_refine_levels_and_offset_3.VARElevationsSet, IN[2]=points_refine_levels_and_offset_3.VARLevelsSet, IN[3]=SystemRefineWallTopConstraints)
# ---------- python_script.python (72 lines) ----------
# Enable Python support and load DesignScript library
# IMPORTANT : ALL DYNAMO DESIGN SCRIPT NODES ARE AS (dg)
import clr
clr.AddReference('ProtoGeometry')
from Autodesk.DesignScript import Geometry as dg

import sys
sys.path.append(r'C:\Program Files (x86)\IronPython 2.7\DLLs')
sys.path.append(r'C:\Program Files (x86)\IronPython 2.7\Lib')
import random

# EXTENSION Enable ToDSType
clr.AddReference('RevitNodes')
import Revit
clr.ImportExtensions(Revit.Elements)

# Enable Revit Elements
from Revit.Elements import *

# EXTENSION Enable Geometry Conversion Methods
clr.ImportExtensions(Revit.GeometryConversion)

# Enable Revit API
clr.AddReference('RevitAPI')
from Autodesk.Revit.DB import *

# Enable DocumentManager and TransactionManager
clr.AddReference('RevitServices')
from RevitServices.Persistence import DocumentManager
from RevitServices.Transactions import TransactionManager

# Enable ICollection List Translate
clr.AddReference("System")
import System.Collections.Generic
from System.Collections.Generic import List

dataEnteringNode = IN
# Use UnwrapElement(IN[0]) When Translating From Dynamo to Revit
walls = UnwrapElement(IN[0])
heights = UnwrapElement(IN[1])
levels = UnwrapElement(IN[2])
proceed = IN[3]

levelids = []
for e in levels:
	levelids.append(e.Id)
# Choose The Current Document
doc = DocumentManager.Instance.CurrentDBDocument
uidoc = DocumentManager.Instance.CurrentUIApplication.ActiveUIDocument
uiapp = DocumentManager.Instance.CurrentUIApplication
app = uiapp.Application

# Create Empty List
result = []

if int(DocumentManager.Instance.CurrentUIApplication.Application.VersionNumber) < 2021:
	units = doc.GetUnits().GetFormatOptions(UnitType.UT_Length).DisplayUnits
	factor = UnitUtils.ConvertToInternalUnits(1,units)
else:
	factor = UnitUtils.ConvertToInternalUnits(1,doc.GetUnits().GetFormatOptions(SpecTypeId.Length).GetUnitTypeId())
	
if proceed:
	counter = 0
	TransactionManager.Instance.EnsureInTransaction(doc)
	for e in walls:
		e.get_Parameter(BuiltInParameter.WALL_HEIGHT_TYPE).Set(levelids[counter])
		e.get_Parameter(BuiltInParameter.WALL_TOP_OFFSET).Set(heights[counter]*factor)
		counter += 1
	TransactionManager.Instance.TransactionTaskDone()
	
# Assign your output to the OUT variable.
OUT = walls
# ----------------------------------------
setParameterByName_3 = Element.SetParameterByName(element=flatten, parameterName=code_block_4.out1, value=points_refine_levels_and_offset.VARElevationsSet)
VARSFloorsandPads = Output(setParameterByName_3)
setParameterByName_4 = Element.SetParameterByName(element=flatten_2, parameterName=code_block_6.out1, value=points_refine_levels_and_offset_2.VARLevelsSet)
VARWalls = Output(setParameterByName_4)
location_of_any_element = Custom[Location Of Any Element](VARElements=byClassName_2.VARout)  # Location Of Any Element
isNull = Object.IsNull(obj=location_of_any_element.VARLocations)
filterByBoolMask = List.FilterByBoolMask(list=location_of_any_element.VARElements, mask=isNull)
filterByBoolMask_2 = List.FilterByBoolMask(list=location_of_any_element.VARLocations, mask=isNull)
code_block_9 = CodeBlock { "Point"; }
byClassName_3 = Custom[SP.Filter.ByClassName](VARobject=filterByBoolMask_2.out, VARclassName=code_block_9)
filterByBoolMask_3 = List.FilterByBoolMask(list=filterByBoolMask.out, mask=byClassName_3.VARbool)
join = List.Join()  # unwired: list0, list1
VARLoadablLevelParameter = Input(VARLoadablLevelParameter: var[]..[])
parameterExists = Custom[CW.Element.ParameterExists](VARparam=VARLoadablLevelParameter, VARelement=filterByBoolMask_3.in)  # Checks if an element contains a parameter of a given name
VARLoadablOffsetParameter = Input(VARLoadablOffsetParameter: var[]..[])
parameterExists_2 = Custom[CW.Element.ParameterExists](VARparam=VARLoadablOffsetParameter, VARelement=filterByBoolMask_3.in)
combine = List.Combine(comb=join, list1=parameterExists, list2=parameterExists_2)
allTrue = List.AllTrue(list=combine, lacing=Longest)
filterByBoolMask_4 = List.FilterByBoolMask(list=filterByBoolMask_3.in, mask=allTrue)
code_block_10 = CodeBlock { "Host"; }
parameterExists_3 = Custom[CW.Element.ParameterExists](VARparam=code_block_10, VARelement=filterByBoolMask_4.in)
filterByBoolMask_5 = List.FilterByBoolMask(list=filterByBoolMask_4.in, mask=parameterExists_3)
filterByBoolMask_6 = List.FilterByBoolMask(list=filterByBoolMask_2.out, mask=byClassName_3.VARbool)
points_refine_levels_and_offset_4 = Custom[Points Refine Levels and Offset](VARLevels=all_elements_of_category, VARPoints=filterByBoolMask_6.in, VARFixFactorDependsofProjectUnits1Formetersforexampleand100forCentimeters=code_block_5)
filterByBoolMask_7 = List.FilterByBoolMask(list=points_refine_levels_and_offset_4.VARLevelsSet, mask=allTrue)
filterByBoolMask_8 = List.FilterByBoolMask(list=filterByBoolMask_7.in, mask=parameterExists_3)
setParameterByName_5 = Element.SetParameterByName(element=filterByBoolMask_5.out, parameterName=VARLoadablLevelParameter, value=filterByBoolMask_8.out)
isNull_2 = Object.IsNull(obj=setParameterByName_5)
filterByBoolMask_9 = List.FilterByBoolMask(list=filterByBoolMask_5.out, mask=isNull_2)
filterByBoolMask_10 = List.FilterByBoolMask(list=points_refine_levels_and_offset_4.VARElevationsSet, mask=allTrue)
filterByBoolMask_11 = List.FilterByBoolMask(list=filterByBoolMask_10.in, mask=parameterExists_3)
filterByBoolMask_12 = List.FilterByBoolMask(list=filterByBoolMask_11.out, mask=isNull_2)
setParameterByName_6 = Element.SetParameterByName(element=filterByBoolMask_9.out, parameterName=VARLoadablOffsetParameter, value=filterByBoolMask_12.out)
VARLoaded = Output(setParameterByName_6)
getParameterValueByName_2 = Element.GetParameterValueByName(element=filterByBoolMask_5.in, parameterName=code_block_10)
code_block_11 = CodeBlock { "Level :"; }
contains = String.Contains(str=getParameterValueByName_2, searchFor=code_block_11)
filterByBoolMask_13 = List.FilterByBoolMask(list=filterByBoolMask_5.in, mask=contains)
filterByBoolMask_14 = List.FilterByBoolMask(list=filterByBoolMask_8.in, mask=contains)
setParameterByName_7 = Element.SetParameterByName(element=filterByBoolMask_13.in, parameterName=VARLoadablLevelParameter, value=filterByBoolMask_14.in)
isNull_3 = Object.IsNull(obj=setParameterByName_7)
filterByBoolMask_15 = List.FilterByBoolMask(list=filterByBoolMask_13.in, mask=isNull_3)
filterByBoolMask_16 = List.FilterByBoolMask(list=filterByBoolMask_11.in, mask=contains)
filterByBoolMask_17 = List.FilterByBoolMask(list=filterByBoolMask_16.in, mask=isNull_3)
setParameterByName_8 = Element.SetParameterByName(element=filterByBoolMask_15.out, parameterName=VARLoadablOffsetParameter, value=filterByBoolMask_17.out)
VARFilteredLoaded = Output(setParameterByName_8)
