# Dynamo custom node Remap Parameters.dyf (Dynamo 2.1.0.7500)
# category: Synthesize.Automate.Parameter
# Randomize Parameters

VARProceed = Input(VARProceed: var[]..[])
VARListofParameterstoRemap = Input(VARListofParameterstoRemap: var[]..[])
VARElementstoWorkon = Input(VARElementstoWorkon: var[]..[])
VARIsTypeParameters = Input(VARIsTypeParameters: var[]..[])
VARValuetoAdd = Input(VARValuetoAdd: var[]..[])
python_script = Python(IN[0]=VARProceed, IN[1]=VARListofParameterstoRemap, IN[2]=VARElementstoWorkon, IN[3]=VARIsTypeParameters, IN[4]=VARValuetoAdd)
# ---------- python_script.python (110 lines) ----------
# Enable Python support and load DesignScript library
# IMPORTANT : ALL DYNAMO DESIGN SCRIPT NODES ARE AS (dg)
import clr
clr.AddReference('ProtoGeometry')
from Autodesk.DesignScript import Geometry as dg

# EXTENSION Enable ToDSType
clr.AddReference('RevitNodes')
import Revit
clr.ImportExtensions(Revit.Elements)

# Enable Revit Elements
from Revit.Elements import *

# EXTENSION Enable Geometry Conversion Methods
clr.ImportExtensions(Revit.GeometryConversion)

# Enable Revit API
clr.AddReference('RevitAPI')
from Autodesk.Revit.DB import *

# Enable DocumentManager and TransactionManager
clr.AddReference('RevitServices')
from RevitServices.Persistence import DocumentManager
from RevitServices.Transactions import TransactionManager

# Enable ICollection List Translate
clr.AddReference("System")
import System.Collections.Generic
from System.Collections.Generic import List

class WarnSwallowSimple(IFailuresPreprocessor):
	def PreprocessFailures(self, failuresAccessor):
		failuresAccessor.DeleteAllWarnings()
		return FailureProcessingResult.Continue

def tolist(obj1):
	if hasattr(obj1,'__iter__'): return obj1
	else: return [obj1]

def flatten(x):
    result = []
    for el in x:
        if hasattr(el, "__iter__") and not isinstance(el, basestring):
            result.extend(flatten(el))
        else:
            result.append(el)
    return result

doc = DocumentManager.Instance.CurrentDBDocument
uidoc = DocumentManager.Instance.CurrentUIApplication.ActiveUIDocument
uiapp = DocumentManager.Instance.CurrentUIApplication
app = uiapp.Application

if int(DocumentManager.Instance.CurrentUIApplication.Application.VersionNumber) < 2021:
	ToInternalfactor = UnitUtils.ConvertToInternalUnits(1,doc.GetUnits().GetFormatOptions(UnitType.UT_Length).DisplayUnits)
else:
	ToInternalfactor = UnitUtils.ConvertToInternalUnits(1,doc.GetUnits().GetFormatOptions(SpecTypeId.Length).GetUnitTypeId())

proceed=IN[0]
params=flatten(tolist(IN[1]))
elements=UnwrapElement(flatten(tolist(IN[2])))
isType=IN[3]
values=flatten(tolist(IN[4]))

# Create Empty List
result = []

handledTypesIds = []
TransactionManager.Instance.ForceCloseTransaction()
trans1 = Transaction(doc, 'Remap Parameters')
trans1.Start()
warnhandle = WarnSwallowSimple()
foptions = trans1.GetFailureHandlingOptions()
foptions.SetFailuresPreprocessor(warnhandle)
trans1.SetFailureHandlingOptions(foptions)
for elem in elements:
	try:
		if isType:
			tid = elem.GetTypeId()
			if tid in handledTypesIds:
				continue
			elem = doc.GetElement(tid)
			handledTypesIds.append(tid)
		accepted = False
		count = 0
		for param in params:
			lookup = elem.LookupParameter(param)
			if lookup != None:
				if proceed:
					if lookup.StorageType  == StorageType.Integer:
						if lookup.HasValue:
							lookup.Set(lookup.AsInteger() + int(values[count]))
						else:
							lookup.Set(int(values[count]))
					elif lookup.StorageType == StorageType.Double:
						if lookup.HasValue:
							lookup.Set(lookup.AsDouble() + (float(values[count])*ToInternalfactor))
						else:
							lookup.Set(float(values[count])*ToInternalfactor)
				accepted = True
			count += 1
		if accepted:
			result.append(elem)
	except:
		continue
trans1.Commit()

# Assign your output to the OUT variable.
OUT = result
# ----------------------------------------
count = List.Count(list=python_script)
VARNumberofElements = Output(count)
VARElementstoselect = Output(python_script)
