# Dynamo custom node Remove Duplicated Solids.dyf (Dynamo 2.1.0.7500)
# category: Synthesize.Automate.Solid
# Remove Duplicated Solids

VARGeometry = Input(VARGeometry: var[]..[])
flatten = List.Flatten(list=VARGeometry)
code_block = CodeBlock { "Solid"; "Surface"; }
byClassName = Custom[SP.Filter.ByClassName](VARobject=flatten, VARclassName=code_block.out0)  # Filters a list of objects by the object's class name. Note that Dynamo elements belong to different classes than their Revit counterparts. Use the Object.Class node to check an object's class.
code_block_2 = CodeBlock { false; }
clean = List.Clean(list=byClassName.VARin, preserveIndices=code_block_2)
flatten_2 = List.Flatten(list=clean)
centroid = Solid.Centroid()  # unwired: solid
uniqueItems = List.UniqueItems(list=centroid)
groupByFunction = List.GroupByFunction(list=flatten_2, func=uniqueItems)
flatten_3 = List.Flatten(list=groupByFunction@L2)
list_firstitem_fixer = Custom[List.FirstItem Fixer](VARlist=flatten_3@L2)  # List.FirstItem Fixer
byClassName_2 = Custom[SP.Filter.ByClassName](VARobject=flatten, VARclassName=code_block.out1)
code_block_3 = CodeBlock { false; }
clean_2 = List.Clean(list=byClassName_2.VARin, preserveIndices=code_block_3)
flatten_4 = List.Flatten(list=clean_2)
create = List.Create(item0=list_firstitem_fixer, item1=flatten_4)
code_block_4 = CodeBlock { false; }
clean_3 = List.Clean(list=create, preserveIndices=code_block_4)
flatten_5 = List.Flatten(list=clean_3)
VARGeometry_2 = Output(flatten_5)  # "VARGeometry"
