# Dynamo custom node Renumber Adaptive Components.dyf (Dynamo 2.1.0.7500)
# category: Synthesize.Automate.Adaptive
# Renumber Adaptive Components

VARAdaptiveComponents = Input(VARAdaptiveComponents: var[]..[])
filter_adaptive_component = Custom[Filter Adaptive Component FamilyInstances](VARFamilyInstances=VARAdaptiveComponents)  # Filter Adaptive Component FamilyInstances
VARNumbersList1 = Input(VARNumbersList1: var[]..[])
code_block = CodeBlock { ","; }
split = String.Split(str=VARNumbersList1, separator0=code_block)
toNumber = String.ToNumber(str=split)
VARNumbersList2 = Input(VARNumbersList2: var[]..[])
split_2 = String.Split(str=VARNumbersList2, separator0=code_block)
toNumber_2 = String.ToNumber(str=split_2)
create = List.Create(item0=toNumber, item1=toNumber_2)
transpose = List.Transpose(lists=create)
python_script = Python(IN[0]=filter_adaptive_component, IN[1]=transpose)
# ---------- python_script.python (75 lines) ----------
# Enable Python support and load DesignScript library
# IMPORTANT : ALL DYNAMO DESIGN SCRIPT NODES ARE AS (dg)
import clr
clr.AddReference('ProtoGeometry')
from Autodesk.DesignScript import Geometry as dg

# EXTENSION Enable ToDSType
clr.AddReference('RevitNodes')
import Revit

# EXTENSION Enable Geometry Conversion Methods
clr.ImportExtensions(Revit.GeometryConversion)

# Enable Revit API
clr.AddReference('RevitAPI')
from Autodesk.Revit.DB import *

# Enable DocumentManager and TransactionManager
clr.AddReference('RevitServices')
from RevitServices.Persistence import DocumentManager
from RevitServices.Transactions import TransactionManager

def tolist(obj1):
	if hasattr(obj1,'__iter__'): return obj1
	else: return [obj1]

def flatten(x):
    result = []
    for el in x:
        if hasattr(el, "__iter__") and not isinstance(el, basestring):
            result.extend(flatten(el))
        else:
            result.append(el)
    return result

element = UnwrapElement(flatten(tolist(IN[0])))
nums = IN[1]

# Choose The Current Document
doc = DocumentManager.Instance.CurrentDBDocument
uidoc = DocumentManager.Instance.CurrentUIApplication.ActiveUIDocument
uiapp = DocumentManager.Instance.CurrentUIApplication
app = uiapp.Application

# Create Empty List
result = []

TransactionManager.Instance.EnsureInTransaction(doc)
for each in element:
	try:
		ids = AdaptiveComponentInstanceUtils.GetInstancePlacementPointElementRefIds(each)
		tmp = []
		for e in ids:
			refpt = doc.GetElement(e)
			elemref = refpt.GetPointElementReference()
			if elemref == None:
				coor = refpt.GetCoordinateSystem().ToCoordinateSystem()
				skp = SketchPlane.Create(doc, coor.XYPlane.ToPlane()).GetPlaneReference()
				xcoor = coor.XAxis.ToXyz()
				orcoor = coor.Origin.ToXyz()
				dynpoints = PointOnPlane.NewPointOnPlane(doc,skp,orcoor,xcoor)
				tmp.append(dynpoints)
			else:
				tmp.append(elemref)
		for num in nums:
			refpt = doc.GetElement(ids[num[0]-1])
			refpt.SetPointElementReference(tmp[num[1]-1])
			refpt = doc.GetElement(ids[num[1]-1])
			refpt.SetPointElementReference(tmp[num[0]-1])
		result.append(each)
	except:
		result.append(None)
TransactionManager.Instance.TransactionTaskDone()

OUT = result
# ----------------------------------------
VARAdaptiveComponents_2 = Output(python_script)  # "VARAdaptiveComponents"
