# Dynamo custom node Restore Material Assets.dyf (Dynamo 2.1.0.7500)
# category: Synthesize.Automate.Material
# Restore Material Assets

code_block = CodeBlock { ","; "-"; }
mod_get_views_by_type = Custom[MOD.Get Views By Type]()  # Get all views in the project classified by type
code_block_2 = CodeBlock { "View Name"; }
getParameterValueByName = Element.GetParameterValueByName(element=mod_get_views_by_type.VARdraftingViews, parameterName=code_block_2)
VARDraftingViewName = Input(VARDraftingViewName: var[]..[])
eq = getParameterValueByName == VARDraftingViewName
filterByBoolMask = List.FilterByBoolMask(list=mod_get_views_by_type.VARdraftingViews, mask=eq)
python_script = Python(IN[0]=filterByBoolMask.in)
# ---------- python_script.python (41 lines) ----------
# Enable Python support and load DesignScript library
# IMPORTANT : ALL DYNAMO DESIGN SCRIPT NODES ARE AS (dg)
import clr
clr.AddReference('ProtoGeometry')
from Autodesk.DesignScript import Geometry as dg

# EXTENSION Enable ToDSType
clr.AddReference('RevitNodes')
import Revit
clr.ImportExtensions(Revit.Elements)

# Enable Revit Elements
from Revit.Elements import *

# EXTENSION Enable Geometry Conversion Methods
clr.ImportExtensions(Revit.GeometryConversion)

# Enable Revit API
clr.AddReference('RevitAPI')
from Autodesk.Revit.DB import *

# Enable DocumentManager and TransactionManager
clr.AddReference('RevitServices')
from RevitServices.Persistence import DocumentManager
from RevitServices.Transactions import TransactionManager

# Enable ICollection List Translate
clr.AddReference("System")
import System.Collections.Generic
from System.Collections.Generic import List

view = UnwrapElement(IN[0])
doc = DocumentManager.Instance.CurrentDBDocument

try:
	collector = FilteredElementCollector(doc,view[0].Id).ToElements();
except:
	collector = []

#Assign your output to the OUT variable.
OUT = collector
# ----------------------------------------
code_block_3 = CodeBlock { "TextNote"; }
byClassName = Custom[SP.Filter.ByClassName](VARobject=python_script, VARclassName=code_block_3)  # Filters a list of objects by the object's class name. Note that Dynamo elements belong to different classes than their Revit counterparts. Use the Object.Class node to check an object's class.
text = TextNote.Text(textNote=byClassName.VARin)
split = String.Split(str=text, separator0=code_block.out1)
split_2 = String.Split(str=split, separator0=code_block.out0)
flatten = List.Flatten(list=split_2@L2)
string_tonumber_fixer = Custom[String.ToNumber Fixer](VARstr=flatten)  # String.ToNumber Fixer
firstItem = List.FirstItem(list=string_tonumber_fixer@L2)
simple_byelement_id_selection = Custom[Simple ByElement Id Selection](VARId=firstItem)  # Simple ByElement Id Selection
isNull = Object.IsNull(obj=simple_byelement_id_selection)
filterByBoolMask_2 = List.FilterByBoolMask(list=string_tonumber_fixer, mask=isNull)
clean = List.Clean(list=filterByBoolMask_2.out)
string_from_object = FromObject(obj=clean)
join = String.Join(separator=code_block.out0, string0=string_from_object)
flatten_2 = List.Flatten(list=join)
isNull_2 = Object.IsNull(obj=simple_byelement_id_selection)
filterByBoolMask_3 = List.FilterByBoolMask(list=simple_byelement_id_selection, mask=isNull_2)
name = Material.Name(material=filterByBoolMask_3.out)
toLower = String.ToLower(str=name)
VARMaterialsToRestore = Input(VARMaterialsToRestore: var[]..[])
VARSeparator = Input(VARSeparator: var[]..[])
split_3 = String.Split(str=VARMaterialsToRestore, separator0=VARSeparator)
trimWhitespace = String.TrimWhitespace(str=split_3)
toLower_2 = String.ToLower(str=trimWhitespace)
contains = List.Contains(list=toLower@L1, item=toLower_2, lacing=CrossProduct)
python_empty_2_false = Custom[Python Empty 2 False](VARIN=contains)  # Python Null 2 Empty
code_block_4 = CodeBlock { 2; }
normalizeDepth = List.NormalizeDepth(list=python_empty_2_false, rank=code_block_4)
anyTrue = Custom[CW.List.AnyTrue](VARseq=normalizeDepth)  # Returns true if any item in a list of booleans is true.
filterByBoolMask_4 = List.FilterByBoolMask(list=flatten, mask=anyTrue)
join_2 = String.Join(separator=code_block.out0, string0=filterByBoolMask_4.in)
flatten_3 = List.Flatten(list=join_2)
removeListFromList = Custom[RH.RemoveListFromList](VARListA=flatten_2, VARListB=flatten_3)  # This node essentially "subtracts" the contents of List B from List A to produce a new list with the unique items.
join_3 = String.Join(separator=code_block.out1, string0=removeListFromList)
flatten_4 = List.Flatten(list=join_3)
code_block_5 = CodeBlock { ""; }
eq_2 = flatten_4 == code_block_5
empty = List.Empty()
length = String.Length(str=VARMaterialsToRestore)
code_block_6 = CodeBlock { 0; }
eq_3 = length == code_block_6
scopeIf = Custom[CW.ScopeIf+](VARtest=eq_3, VARtrue=empty, VARfalse=byClassName.VARin)  # A (hopefully) more robust implementation of ScopeIf. Tests a single boolean and returns a value accordingly.
scopeIf_2 = Custom[CW.ScopeIf+](VARtest=eq_2, VARtrue=empty, VARfalse=scopeIf)
setText = TextNote.SetText(textNote=scopeIf_2, value=flatten_4)
code_block_7 = CodeBlock { null; }
scopeIf_3 = Custom[CW.ScopeIf+](VARtest=eq_3, VARtrue=filterByBoolMask.in, VARfalse=code_block_7)
eraser = Custom[ST.Tool.Eraser](VARList=scopeIf_3)  # Try to delete any element from project
code_block_8 = CodeBlock { "DONE"; }
VAROut = Output(code_block_8)
filterByBoolMask_5 = List.FilterByBoolMask(list=filterByBoolMask_3.out, mask=anyTrue)
lastItem = List.LastItem(list=string_tonumber_fixer@L2)
simple_byelement_id_selection_2 = Custom[Simple ByElement Id Selection](VARId=lastItem)
filterByBoolMask_6 = List.FilterByBoolMask(list=simple_byelement_id_selection_2, mask=isNull_2)
id = Element.Id()  # unwired: element
map = List.Map(list=filterByBoolMask_6.out, f_x=id)
filterByBoolMask_7 = List.FilterByBoolMask(list=map, mask=anyTrue)
setMaterialAssetByAssetId = Custom[AL.Material.SetMaterialAssetByAssetId](VARTargetMaterial=filterByBoolMask_5.in, VARAssetId=filterByBoolMask_7.in)  # This node will set the material asset by asset id. Please make sure that the two input lists match in length.
VARPrefix = Input(VARPrefix: var[]..[])
python_script_2 = Python(IN[0]=setMaterialAssetByAssetId, IN[1]=VARPrefix)
# ---------- python_script_2.python (69 lines) ----------
# Enable Python support and load DesignScript library
# IMPORTANT : ALL DYNAMO DESIGN SCRIPT NODES ARE AS (dg)
import clr
clr.AddReference('ProtoGeometry')
from Autodesk.DesignScript import Geometry as dg

# EXTENSION Enable ToDSType
clr.AddReference('RevitNodes')
import Revit
clr.ImportExtensions(Revit.Elements)

# Enable Revit Elements
from Revit.Elements import *

# EXTENSION Enable Geometry Conversion Methods
clr.ImportExtensions(Revit.GeometryConversion)

# Enable Revit API
clr.AddReference('RevitAPI')
from Autodesk.Revit.DB import *

# Enable DocumentManager and TransactionManager
clr.AddReference('RevitServices')
from RevitServices.Persistence import DocumentManager
from RevitServices.Transactions import TransactionManager

# Enable ICollection List Translate
clr.AddReference("System")
import System.Collections.Generic
from System.Collections.Generic import List

def tolist(obj1):
	if hasattr(obj1,'__iter__'): return obj1
	else: return [obj1]

dataEnteringNode = IN
# Use UnwrapElement(IN[0]) When Translating From Dynamo to Revit
materials = UnwrapElement(tolist(IN[0]))
prefix = IN[1]
# Choose The Current Document
doc = DocumentManager.Instance.CurrentDBDocument
uidoc = DocumentManager.Instance.CurrentUIApplication.ActiveUIDocument
uiapp = DocumentManager.Instance.CurrentUIApplication
app = uiapp.Application

# Create Empty List
result = []

# Start a Transaction with Current Document (doc)
TransactionManager.Instance.EnsureInTransaction(doc)

if len(prefix) != 0:
	for e in materials:
		try:
			currentname = e.Name
			special = ["\\",":","{","}","[","]","|",";","<",">","?","`","~"]
			for s in special:
				currentname = currentname.replace(s,"")
			if currentname.startswith(prefix):
				newname = currentname.replace(prefix,"")
				e.Name = newname
		except:
			pass

# End the Transaction with Current Document ()
TransactionManager.Instance.TransactionTaskDone()

# Assign your output to the OUT variable.
OUT = "Done"
# ----------------------------------------
scopeIf_4 = Custom[CW.ScopeIf+](VARtest=eq_3, VARtrue=filterByBoolMask_3.out, VARfalse=code_block_7)
scopeIf_5 = Custom[CW.ScopeIf+](VARtest=eq_3, VARtrue=map, VARfalse=code_block_7)
isNull_3 = Object.IsNull(obj=scopeIf_5)
filterByBoolMask_8 = List.FilterByBoolMask(list=scopeIf_4, mask=isNull_3)
filterByBoolMask_9 = List.FilterByBoolMask(list=scopeIf_5, mask=isNull_3)
setMaterialAssetByAssetId_2 = Custom[AL.Material.SetMaterialAssetByAssetId](VARTargetMaterial=filterByBoolMask_8.out, VARAssetId=filterByBoolMask_9.out)
python_script_3 = Python(IN[0]=setMaterialAssetByAssetId_2, IN[1]=VARPrefix)  # same code as python_script_2
