# Dynamo custom node Revit Extrusion By Imported Geometry.dyf (Dynamo 2.1.0.7500)
# category: Synthesize.Automate.Family
# Revit Extrusion By Imported Geometry

VARImportedGeometry = Input(VARImportedGeometry: var[]..[])
geometry = Element.Geometry(element=VARImportedGeometry)
flatten = List.Flatten(list=geometry)
code_block = CodeBlock { "Surface"; }
byClassName = Custom[SP.Filter.ByClassName](VARobject=flatten, VARclassName=code_block)  # Filters a list of objects by the object's class name. Note that Dynamo elements belong to different classes than their Revit counterparts. Use the Object.Class node to check an object's class.
perimeterCurves = Surface.PerimeterCurves(surface=byClassName.VARin)
as_polycurve_bycurves = Custom[AS.[&] PolyCurve.ByCurves](VARcurves=perimeterCurves@L2)  # Create polycurves from an unordered list of curves.
flatten_2 = List.Flatten(list=as_polycurve_bycurves.VARpolyCurve)
curves = PolyCurve.Curves(polyCurve=flatten_2)
VAROffset = Input(VAROffset: var[]..[])
curves_offset_to_revit = Custom[Curves Offset To Revit Compatibility](VARCurves=curves, VAROffset=VAROffset)  # Curves Offset To Revit Compatibility
byPatch = Surface.ByPatch(closedCurve=flatten_2)
flipNormalDirection = Surface.FlipNormalDirection(surface=byPatch)
code_block_2 = CodeBlock { 0.5; }
pointAtParameter = Surface.PointAtParameter(surface=flipNormalDirection, u=code_block_2, v=code_block_2)
normalAtPoint = Surface.NormalAtPoint(surface=flipNormalDirection, point=pointAtParameter)
byOriginNormal = Plane.ByOriginNormal(origin=pointAtParameter, normal=normalAtPoint)
byPlane = SketchPlane.ByPlane(plane=byOriginNormal)
revit_extrusion_by_curve_and = Custom[Revit Extrusion By Curve and Sketchplane](VARCurves=curves_offset_to_revit.VARCurves@L2, VARSketchPlane=byPlane@L1)  # Revit Extrusion By Curve and Sketchplane
code_block_3 = CodeBlock { false; }
clean = List.Clean(list=revit_extrusion_by_curve_and, preserveIndices=code_block_3)
flatten_3 = List.Flatten(list=clean)
count = List.Count(list=flatten_3)
VARCount = Output(count)
VAROutput = Output(revit_extrusion_by_curve_and)
VARSketchPlanes = Output(byPlane)
