# Dynamo custom node Revit Links Batch Placement.dyf (Dynamo 2.1.0.7500)
# category: Synthesize.Automate.Links
# Revit Links Batch Placement (Link Reference 0 = Origin | 1 = Shared | 2 = Basepoint | 3 = Cenetered)

VARRevitLinkType = Input(VARRevitLinkType: var[]..[])
VARLocations = Input(VARLocations: var[]..[])
VARRotations = Input(VARRotations: var[]..[])
python_script = Python(IN[0]=VARRevitLinkType, IN[1]=VARLocations, IN[2]=VARRotations)
# ---------- python_script.python (61 lines) ----------
# Enable Python support and load DesignScript library
# IMPORTANT : ALL DYNAMO DESIGN SCRIPT NODES ARE AS (dg)
import clr
clr.AddReference('ProtoGeometry')
from Autodesk.DesignScript import Geometry as dg

# EXTENSION Enable ToDSType
clr.AddReference('RevitNodes')
import Revit
clr.ImportExtensions(Revit.Elements)

# Enable Revit Elements
from Revit.Elements import *

# EXTENSION Enable Geometry Conversion Methods
clr.ImportExtensions(Revit.GeometryConversion)

# Enable Revit API
clr.AddReference('RevitAPI')
from Autodesk.Revit.DB import *

# Enable DocumentManager and TransactionManager
clr.AddReference('RevitServices')
from RevitServices.Persistence import DocumentManager
from RevitServices.Transactions import TransactionManager

# Enable ICollection List Translate
clr.AddReference("System")
import System.Collections.Generic
from System.Collections.Generic import List

import math

doc = DocumentManager.Instance.CurrentDBDocument
link = IN[0]
location = IN[1]
rotations = IN[2]

uLink = UnwrapElement(link)
id=uLink.Id
xyz = []
result = []

for e in location:
	xyz.append(e.ToXyz())

TransactionManager.Instance.EnsureInTransaction(doc)


for eachpoint in xyz:
	newInstance = RevitLinkInstance.Create(doc,id,ImportPlacement.Origin)
	loc = newInstance.Location
	new2 = loc.Move(eachpoint)
	result.append(newInstance)
	instanceid = newInstance.Id
	axis = Line.CreateBound(eachpoint, XYZ(eachpoint.X,eachpoint.Y,eachpoint.Z +1))
	ElementTransformUtils.RotateElement(doc,instanceid,axis,rotations[xyz.index(eachpoint)]*math.pi/-180)

TransactionManager.Instance.TransactionTaskDone()

OUT = result
# ----------------------------------------
VARLinkInstance = Output(python_script)
