# Dynamo custom node Room Smart Height Detection.dyf (Dynamo 2.1.0.7500)
# category: Synthesize.Automate.Parameter
# Room Smart Height Detection

VARAllRooms = Input(VARAllRooms: var[]..[])
code_block = CodeBlock { true; }
lb_lunchbox_room_element = Custom[LB.LunchBox Room Element Collector](VARToggle=code_block)  # Collects rooms from the Revit document
VARYesNoSyncParameter = Input(VARYesNoSyncParameter: var[]..[])
string_from_object = FromObject(obj=VARYesNoSyncParameter)
getParameterValueByName = Element.GetParameterValueByName(element=lb_lunchbox_room_element.VARElement, parameterName=string_from_object)
code_block_2 = CodeBlock { 1; }
eq = getParameterValueByName == code_block_2
filterByBoolMask = List.FilterByBoolMask(list=lb_lunchbox_room_element.VARElement, mask=eq)
scopeIf = Custom[CW.ScopeIf+](VARtest=VARAllRooms, VARtrue=lb_lunchbox_room_element.VARElement, VARfalse=filterByBoolMask.in)  # A (hopefully) more robust implementation of ScopeIf. Tests a single boolean and returns a value accordingly.
flatten = List.Flatten(list=scopeIf)
python_script = Python(IN[0]=flatten)
# ---------- python_script.python (67 lines) ----------
# Enable Python support and load DesignScript library
# IMPORTANT : ALL DYNAMO DESIGN SCRIPT NODES ARE AS (dg)
import clr
clr.AddReference('ProtoGeometry')
from Autodesk.DesignScript import Geometry as dg

# EXTENSION Enable ToDSType
clr.AddReference('RevitNodes')
import Revit
clr.ImportExtensions(Revit.Elements)

# Enable Revit Elements
from Revit.Elements import *

# EXTENSION Enable Geometry Conversion Methods
clr.ImportExtensions(Revit.GeometryConversion)

# Enable Revit API
clr.AddReference('RevitAPI')
from Autodesk.Revit.DB import *

# Enable DocumentManager and TransactionManager
clr.AddReference('RevitServices')
from RevitServices.Persistence import DocumentManager
from RevitServices.Transactions import TransactionManager

# Enable ICollection List Translate
clr.AddReference("System")
import System.Collections.Generic
from System.Collections.Generic import List

def flatten(x):
    result = []
    for el in x:
        if hasattr(el, "__iter__") and not isinstance(el, basestring):
            result.extend(flatten(el))
        else:
            result.append(el)
    return result

doc = DocumentManager.Instance.CurrentDBDocument

collector = FilteredElementCollector(doc,doc.ActiveView.Id).ToElements();

result = []
result.append(FilteredElementCollector(doc).OfCategory(BuiltInCategory.OST_Ceilings).WhereElementIsNotElementType().ToElements())
result.append(FilteredElementCollector(doc).OfCategory(BuiltInCategory.OST_Columns).WhereElementIsNotElementType().ToElements())
result.append(FilteredElementCollector(doc).OfCategory(BuiltInCategory.OST_Floors).WhereElementIsNotElementType().ToElements())
result.append(FilteredElementCollector(doc).OfCategory(BuiltInCategory.OST_Walls).WhereElementIsNotElementType().ToElements())
result.append(FilteredElementCollector(doc).OfCategory(BuiltInCategory.OST_Roofs).WhereElementIsNotElementType().ToElements())

result = flatten(result)
# Start a Transaction with Current Document (doc)
TransactionManager.Instance.EnsureInTransaction(doc)

boundhistory = []
for e in result:
	param = e.get_Parameter(BuiltInParameter.WALL_ATTR_ROOM_BOUNDING)
	boundhistory.append(param.AsInteger())
	param.Set(1)

# End the Transaction with Current Document ()
TransactionManager.Instance.TransactionTaskDone()
Revit.Transaction.Transaction.End(doc)

#Assign your output to the OUT variable.
OUT = boundhistory,result
# ----------------------------------------
python_script_2 = Python(IN[0]=flatten, IN[1]=python_script)
# ---------- python_script_2.python (59 lines) ----------
# Enable Python support and load DesignScript library
# IMPORTANT : ALL DYNAMO DESIGN SCRIPT NODES ARE AS (dg)
import clr
clr.AddReference('ProtoGeometry')
from Autodesk.DesignScript import Geometry as dg

# EXTENSION Enable ToDSType
clr.AddReference('RevitNodes')
import Revit
clr.ImportExtensions(Revit.Elements)

# Enable Revit Elements
from Revit.Elements import *

# EXTENSION Enable Geometry Conversion Methods
clr.ImportExtensions(Revit.GeometryConversion)

# Enable Revit API
clr.AddReference('RevitAPI')
from Autodesk.Revit.DB import *

# Enable DocumentManager and TransactionManager
clr.AddReference('RevitServices')
from RevitServices.Persistence import DocumentManager
from RevitServices.Transactions import TransactionManager

# Enable ICollection List Translate
clr.AddReference("System")
import System.Collections.Generic
from System.Collections.Generic import List

dataEnteringNode = IN
# Use UnwrapElement(IN[0]) When Translating From Dynamo to Revit
rooms = IN[0]
boundhistory = IN[1][0]

# Choose The Current Document
doc = DocumentManager.Instance.CurrentDBDocument
uidoc = DocumentManager.Instance.CurrentUIApplication.ActiveUIDocument
uiapp = DocumentManager.Instance.CurrentUIApplication
app = uiapp.Application

# Create Empty List
result = []

# Start a Transaction with Current Document (doc)
TransactionManager.Instance.EnsureInTransaction(doc)

settings = AreaVolumeSettings.GetAreaVolumeSettings(doc)
currentset = settings.ComputeVolumes
if currentset == False:
	settings.ComputeVolumes = True
history = currentset

TransactionManager.Instance.TransactionTaskDone()
Revit.Transaction.Transaction.End(doc)

# Assign your output to the OUT variable.
OUT = history,rooms,boundhistory
# ----------------------------------------
code_block_3 = CodeBlock(a=python_script_2) { a[0]; a[1]; a[2]; }
state = Custom[CW.Room.State](VARroom=code_block_3.out1)  # Returns the state of a room, i.e. is it placed, unplaced, redundant or not enclosed.
code_block_4 = CodeBlock { "Placed"; }
eq_2 = state == code_block_4
filterByBoolMask_2 = List.FilterByBoolMask(list=code_block_3.out1, mask=eq_2)
code_block_5 = CodeBlock { "Limit Offset"; }
getParameterValueByName_2 = Element.GetParameterValueByName(element=filterByBoolMask_2.in, parameterName=code_block_5)
passthrough = Custom[CW.Passthrough](VARpassThrough=filterByBoolMask_2.in, VARwaitFor=getParameterValueByName_2)  # Forces a sequential order of execution. The node wired into the output of the Passthrough node will be executed *after* the node wired into the waitFor input (e.g. important for some Revit operations). The value of the passThrough input will be passed on to the node wired into the output port of the Passthrough node.
code_block_6 = CodeBlock { "Limit Offset"; "Base Offset"; "Upper Limit"; }
VARMaximumRoomHeight = Input(VARMaximumRoomHeight: var[]..[])
setParameterByName = Element.SetParameterByName(element=passthrough, parameterName=code_block_5, value=VARMaximumRoomHeight)
end = Revit.Transaction.Transaction.End(input=setParameterByName)
passthrough_2 = Custom[CW.Passthrough](VARpassThrough=passthrough, VARwaitFor=end)
fix_room_heights_data = Custom[Fix Room Heights Data](VARRooms=passthrough_2)  # Fix Room Heights Data
setParameterByName_2 = Element.SetParameterByName(element=passthrough, parameterName=code_block_6.out0, value=fix_room_heights_data.VARLimitOffsets)
python_script_3 = Python()  # unwired: IN[0]
# ---------- python_script_3.python (62 lines) ----------
'''
# Enable Python support and load DesignScript library
# IMPORTANT : ALL DYNAMO DESIGN SCRIPT NODES ARE AS (dg)
import clr
clr.AddReference('ProtoGeometry')
from Autodesk.DesignScript import Geometry as dg

# EXTENSION Enable ToDSType
clr.AddReference('RevitNodes')
import Revit
clr.ImportExtensions(Revit.Elements)

# Enable Revit Elements
from Revit.Elements import *

# EXTENSION Enable Geometry Conversion Methods
clr.ImportExtensions(Revit.GeometryConversion)

# Enable Revit API
clr.AddReference('RevitAPI')
from Autodesk.Revit.DB import *

# Enable DocumentManager and TransactionManager
clr.AddReference('RevitServices')
from RevitServices.Persistence import DocumentManager
from RevitServices.Transactions import TransactionManager

# Enable ICollection List Translate
clr.AddReference("System")
import System.Collections.Generic

doc = DocumentManager.Instance.CurrentDBDocument

dataEnteringNode = IN
# Use UnwrapElement(IN[0]) When Translating From Dynamo to Revit
inside=UnwrapElement(IN[0])

formatoptions = doc.GetUnits().GetFormatOptions(UnitType.UT_Length)
dispunits = formatoptions.DisplayUnits
factor = UnitUtils.ConvertFromInternalUnits(1, dispunits)

# Create Empty List
result = []

opt1 = Options()
opt1.ComputeReferences = False

tmp = []
for e in inside:
	geoms = e.get_Geometry(opt1)
	tmplist = []
	for g in geoms:
		g1 = g.GetBoundingBox().Max.Z
		g2 = g.GetBoundingBox().Min.Z
		gtotal = g1 - g2 
		fixedgtotal = gtotal*factor
		tmplist.append(fixedgtotal)
	result.append(tmplist[0])

# Assign your output to the OUT variable.
OUT = result
'''
# ----------------------------------------
code_block_7 = CodeBlock { false; }
clean = List.Clean(list=filterByBoolMask_2.in, preserveIndices=code_block_7)
flatten_2 = List.Flatten(list=clean)
map_to_parameter = StringInput("Upper Limit")
getParameterValueByName_3 = Element.GetParameterValueByName(element=flatten_2, parameterName=map_to_parameter)
passthrough_3 = Custom[CW.Passthrough](VARpassThrough=flatten_2, VARwaitFor=getParameterValueByName_3)
setParameterByName_3 = Element.SetParameterByName(element=passthrough_3, parameterName=code_block_6.out2, value=fix_room_heights_data.VARUpperLimitLevels)
VARUpperLimit = Output(getParameterValueByName_3)
VARLimitOffset = Output(getParameterValueByName_2)
VARVolumeStatus = Output(code_block_3.out0)
VARRooms = Output(filterByBoolMask_2.in)
VARBoundingStatus = Output(code_block_3.out2)
code_block_8 = CodeBlock(a=python_script) { a[1]; }
VARBoundElements = Output(code_block_8)
setParameterByName_4 = Element.SetParameterByName(element=passthrough, parameterName=code_block_6.out1, value=fix_room_heights_data.VARBaseOffsets)
