# Dynamo custom node Rooms Upper Surfaces.dyf (Dynamo 2.1.0.7500)
# category: Synthesize.Automate.Surface
# Rooms Upper Surfaces

VARAllRooms = Input(VARAllRooms: var[]..[])
code_block = CodeBlock { true; }
lb_lunchbox_room_element = Custom[LB.LunchBox Room Element Collector](VARToggle=code_block)  # Collects rooms from the Revit document
VARYesNoSyncParameter = Input(VARYesNoSyncParameter: var[]..[])
getParameterValueByName = Element.GetParameterValueByName(element=lb_lunchbox_room_element.VARElement, parameterName=VARYesNoSyncParameter)
code_block_2 = CodeBlock { 1; }
eq = getParameterValueByName == code_block_2
filterByBoolMask = List.FilterByBoolMask(list=lb_lunchbox_room_element.VARElement, mask=eq)
scopeIf = Custom[CW.ScopeIf+](VARtest=VARAllRooms, VARtrue=lb_lunchbox_room_element.VARElement, VARfalse=filterByBoolMask.in)  # A (hopefully) more robust implementation of ScopeIf. Tests a single boolean and returns a value accordingly.
flatten = List.Flatten(list=scopeIf)
category_of_the_resulted_spaces = Categories("OST_GenericModel")
filterByBoolMask_2 = List.FilterByBoolMask(list=lb_lunchbox_room_element.VARNumber, mask=eq)
scopeIf_2 = Custom[CW.ScopeIf+](VARtest=VARAllRooms, VARtrue=lb_lunchbox_room_element.VARNumber, VARfalse=filterByBoolMask_2.in)
flatten_2 = List.Flatten(list=scopeIf_2)
rooms_to_directshape = Custom[Rooms To DirectShape](VARRooms=flatten, VARCategory=category_of_the_resulted_spaces, VARNames=flatten_2)  # Rooms To DirectShape
isNull = Object.IsNull(obj=rooms_to_directshape)
filterByBoolMask_3 = List.FilterByBoolMask(list=rooms_to_directshape, mask=isNull)
end = Revit.Transaction.Transaction.End(input=filterByBoolMask_3.out)
element_geometry_fast = Custom[Element.Geometry Fast](VARElements=end)  # Element.Geometry Fast
explode = Geometry.Explode(geometry=element_geometry_fast)
code_block_3 = CodeBlock { 0.5; }
pointAtParameter = Surface.PointAtParameter(surface=explode, u=code_block_3, v=code_block_3)
Z = Point.Z(point=pointAtParameter)
maximumItem = List.MaximumItem(list=Z)
code_block_4 = CodeBlock { 3; }
round = Math.Round(number=maximumItem, digits=code_block_4)
round_2 = Math.Round(number=Z, digits=code_block_4)
eq_2 = round == round_2
filterByBoolMask_4 = List.FilterByBoolMask(list=explode, mask=eq_2)
flatten_3 = List.Flatten(list=filterByBoolMask_4.in)
passthrough = Custom[CW.Passthrough](VARpassThrough=end, VARwaitFor=flatten_3)  # Forces a sequential order of execution. The node wired into the output of the Passthrough node will be executed *after* the node wired into the waitFor input (e.g. important for some Revit operations). The value of the passThrough input will be passed on to the node wired into the output port of the Passthrough node.
eraser = Custom[ST.Tool.Eraser](VARList=passthrough)  # Try to delete any element from project
VARUpperSurfaces = Output(flatten_3)
minimumItem = List.MinimumItem(list=Z)
round_3 = Math.Round(number=minimumItem, digits=code_block_4)
round_4 = Math.Round(number=Z, digits=code_block_4)
eq_3 = round_3 == round_4
filterByBoolMask_5 = List.FilterByBoolMask(list=explode, mask=eq_3)
flatten_4 = List.Flatten(list=filterByBoolMask_5.in)
VARDownerSurfaces = Output(flatten_4)
