# Dynamo custom node Rotate By Custom Point.dyf (Dynamo 2.1.0.7500)
# category: Synthesize.Automate.Family
# Rotate By Custom Point

VARElements = Input(VARElements: var[]..[])
VARBasePoints = Input(VARBasePoints: var[]..[])
VARRotations = Input(VARRotations: var[]..[])
python_script = Python(IN[0]=VARElements, IN[1]=VARBasePoints, IN[2]=VARRotations)
# ---------- python_script.python (45 lines) ----------
# Thanks to zachitect
# Enable Python support and load DesignScript library
import clr
clr.AddReference('ProtoGeometry')
from Autodesk.DesignScript.Geometry import *

# Import Revit Nodes
clr.AddReference("RevitNodes")
import Revit
clr.ImportExtensions(Revit.Elements)

# Import Revit API dll
import Autodesk
clr.AddReference("RevitAPI")
from Autodesk.Revit.DB import *

# Import DocumentManager and TransactionManager
clr.AddReference("RevitServices")
from RevitServices.Persistence import DocumentManager
from RevitServices.Transactions import TransactionManager

# Pointing the current Document
doc = DocumentManager.Instance.CurrentDBDocument
# ----------
FamilyInstance = UnwrapElement(IN[0])
BasePoint = UnwrapElement(IN[1])
RotationAngle = UnwrapElement(IN[2])

#Convert Display Unit to Interal Unit
def CTI(metre):
	return Autodesk.Revit.DB.UnitUtils.ConvertToInternalUnits(metre, Autodesk.Revit.DB.DisplayUnitType.DUT_METERS)

# ----------
# Start the Transaction
TransactionManager.Instance.EnsureInTransaction(doc)

# Conducting Transaction
# ----------
for fi, bp, ag in zip(FamilyInstance, BasePoint, RotationAngle):
	axis = Autodesk.Revit.DB.Line.CreateBound(XYZ(CTI(bp.X), CTI(bp.Y), CTI(bp.Z)), XYZ(CTI(bp.X), CTI(bp.Y), CTI(bp.Z+1)))
	Autodesk.Revit.DB.ElementTransformUtils.RotateElement(doc, fi.Id, axis, ag)
# ----------
# Finish the Transaction
TransactionManager.Instance.TransactionTaskDone()
OUT = "Operation Finished"
# ----------------------------------------
VAROutput = Output(python_script)
