# Dynamo custom node SAT To Topography.dyf (Dynamo 2.1.0.7500)
# category: Synthesize.Automate.Topography
# SAT To Topography

VARTopography = Input(VARTopography: var[]..[])
geometry = Element.Geometry(element=VARTopography)
perimeterCurves = Surface.PerimeterCurves(surface=geometry)
flatten = List.Flatten(list=perimeterCurves)
startPoint = Curve.StartPoint(curve=flatten)
code_block = CodeBlock { false; }
clean = List.Clean(list=startPoint, preserveIndices=code_block)
pruneDuplicates = Custom[SP.Points.PruneDuplicates+](VARpoints=clean)  # An alternative to the built in node, that performs faster at the price of loosing the order of the points. All floating point valies are rounded to the nearest 4 decimal points. You can optionally remove duplicate Z values by setting "keepDuplicateZ" to false.
byPoints = Topography.ByPoints(points=pruneDuplicates)
VARTopography_2 = Output(byPoints)  # "VARTopography"
