# Dynamo custom node SP.Beams.FixExtents.dyf (Dynamo 2.1.0.7500)
# category: Synthesize.Packages.Springs.Revit.Utility
# Detects all beams from the input list with broken extents(actual length - cut length <  margin) and attemts to correct them.

VARbeams = Input(VARbeams: var[])
code_block = CodeBlock { "framing"; }
byClassName = Custom[SP.Filter.ByClassName](VARobject=VARbeams, VARclassName=code_block)  # Filters a list of objects by the object's class name. Note that Dynamo elements belong to different classes than their Revit counterparts. Use the Object.Class node to check an object's class.
VARmargin = Input(VARmargin: double = 250)
code_block_2 = CodeBlock(str1=byClassName.VARin, margin=VARmargin)
# ---------- code_block_2.designscript (4 lines) ----------
la = str1.GetParameterValueByName("Length");
lb = str1.GetParameterValueByName("Cut Length");
mask1  = Math.Abs(la - lb) > margin;
DSCore.List.FilterByBoolMask(str1,mask1)["in"];
# ----------------------------------------
python_script = Python(IN[0]=code_block_2.out3)
# ---------- python_script.python (44 lines) ----------
#Copyright(c) 2015, Dimitar Venkov
# @5devene, dimitar.ven@gmail.com

import clr

clr.AddReference("RevitServices")
import RevitServices
from RevitServices.Persistence import DocumentManager
from RevitServices.Transactions import TransactionManager
doc = DocumentManager.Instance.CurrentDBDocument
uidoc=DocumentManager.Instance.CurrentUIApplication.ActiveUIDocument

clr.AddReference("RevitNodes")
import Revit
clr.ImportExtensions(Revit.Elements)

clr.AddReference("RevitAPI")
from Autodesk.Revit.DB import ElementId
from Autodesk.Revit.DB.Structure import StructuralFramingUtils

clr.AddReference("System")
from System.Collections.Generic import List as cList

def tolist(obj1):
	if hasattr(obj1,"__iter__"):
		return obj1
	else:
		return [obj1]

beams = UnwrapElement(tolist(IN[0]))

TransactionManager.Instance.EnsureInTransaction(doc)
for b in beams:
	try:
		StructuralFramingUtils.DisallowJoinAtEnd(b,0)
		StructuralFramingUtils.DisallowJoinAtEnd(b,1)
	except:
		pass
		
ids1 = [e.Id for e in beams]
ids2 = cList[ElementId](ids1)
uidoc.Selection.SetElementIds(ids2)
OUT = "%s beams corrected in Revit." %ids2.Count
TransactionManager.Instance.TransactionTaskDone()
# ----------------------------------------
VARresult = Output(python_script)
VARrefresh = Input(VARrefresh: bool = false)
