# Dynamo custom node SP.Collector.ElementSketch.dyf (Dynamo 2.1.0.7500)
# category: Synthesize.Packages.Springs.Revit.Collectors
# Get the actual sketch lines of a sketch based element (floor, ceiling, modified wall, etc.) . You can optionally fetch the matching model curves, however this might prove comptationally heavy on larger data sets.

VARelement = Input(VARelement: var[])
VARfetchModelCurves = Input(VARfetchModelCurves: bool = false)
VARrefresh = Input(VARrefresh: bool = true)
python_script = Python(IN[0]=VARelement, IN[1]=VARfetchModelCurves, IN[2]=VARrefresh)
# ---------- python_script.python (94 lines) ----------
#Copyright(c) 2016, Dimitar Venkov
# @5devene, dimitar.ven@gmail.com

import clr
import math

clr.AddReference("RevitServices")
import RevitServices
from RevitServices.Persistence import DocumentManager
from RevitServices.Transactions import TransactionManager
doc = DocumentManager.Instance.CurrentDBDocument

clr.AddReference("RevitNodes")
import Revit
clr.ImportExtensions(Revit.Elements)
clr.ImportExtensions(Revit.GeometryConversion)

clr.AddReference("RevitAPI")
from Autodesk.Revit.DB import *

def tolist(obj1):
	if hasattr(obj1,"__iter__"): return obj1
	else: return [obj1]

def output1(l1):
	if len(l1) == 1: return l1[0]
	else: return l1

elements = UnwrapElement(tolist(IN[0]))
getModel = IN[1]

accepted_mc = "Autodesk.Revit.DB.ModelLine, Autodesk.Revit.DB.ModelArc, Autodesk.Revit.DB.ModelEllipse, Autodesk.Revit.DB.ModelHermiteSpline, Autodesk.Revit.DB.ModelNurbSpline"

def almost_eq(line, mc):
	line2 = mc.Location.Curve
	xyz1 = line.Evaluate(0.5, True)
	if not line2.IsBound:
		xyz2 = line2.Center
		try: xyz1 = line.Center
		except: pass
	else:
		xyz2 = line2.Evaluate(0.5, True)
	if xyz1.DistanceTo(xyz2) <= 0.0001:
		return True
	else:
		return False

def clean1(l1):
	for i in xrange(len(l1) ):
		l1[i] = [x for x in l1[i] if x != None]
	return l1

def getSketch(el1):
	try:
		sk1 = doc.GetElement(ElementId(el1.Id.IntegerValue - 1) )
	except:
		sk1 = None
	if not getModel and sk1 is not None and sk1.GetType().ToString() == 'Autodesk.Revit.DB.Sketch':
		profile = sk1.Profile
	else:
		t1 = SubTransaction(doc)
		t1.Start()
		deleted = doc.Delete(el1.Id)
		t1.RollBack()
		
		profile, mc = CurveArrArray(), []
		for d in deleted:
			test_el = doc.GetElement(d)
			el_type = test_el.GetType().ToString()
			if el_type == "Autodesk.Revit.DB.Sketch":
				profile = test_el.Profile
				if not getModel:
					break
			elif getModel and el_type in accepted_mc :
				mc.append(test_el)

	ordered_mc = [ [None] * i.Size for i in profile] if getModel else []
	curves = [ [None] * i.Size for i in profile]
	for i in xrange(profile.Size):
		for j in xrange(profile[i].Size):
			curves[i][j] = profile[i][j].ToProtoType()
			if getModel:
				for k in xrange(len(mc)):
					if almost_eq(profile[i][j], mc[k]):
						ordered_mc[i][j] = mc[k].ToDSType(True)
						del mc[k]
						break
						
	return curves, clean1(ordered_mc)

TransactionManager.Instance.EnsureInTransaction(doc)
result = map(getSketch, elements)
TransactionManager.Instance.TransactionTaskDone()
OUT = output1([r[0] for r in result]), output1([r[1] for r in result])
# ----------------------------------------
code_block = CodeBlock(res=python_script) { res[0]; res[1]; }
code_block_2 = CodeBlock { 0; }
code_block_3 = CodeBlock { "Roof"; }
filterByString = Custom[ST.List.FilterByString](VARlist=VARelement, VARString=code_block_3)  # Filter a list by a string match
code_block_4 = CodeBlock { "Base Level"; "Base Offset From Level"; }
getParameterValueByName = Element.GetParameterValueByName(element=filterByString.VARMatch, parameterName=code_block_4.out1)
code_block_5 = CodeBlock { "Level"; "Height Offset From Level"; }
getParameterValueByName_2 = Element.GetParameterValueByName(element=filterByString.VAROther, parameterName=code_block_5.out1)
mergeByBoolMask = Custom[SP.List.MergeByBoolMask](VARIn=getParameterValueByName, VAROut=getParameterValueByName_2, VARmask=filterByString.VARBool)  # Merge two lists by a boolean mask list. The true count in the mask should be the same as the length of the true list and vice versa for the false list.
getParameterValueByName_3 = Element.GetParameterValueByName(element=filterByString.VARMatch, parameterName=code_block_4.out0)
getParameterValueByName_4 = Element.GetParameterValueByName(element=filterByString.VAROther, parameterName=code_block_5.out0)
mergeByBoolMask_2 = Custom[SP.List.MergeByBoolMask](VARIn=getParameterValueByName_3, VAROut=getParameterValueByName_4, VARmask=filterByString.VARBool)
projectElevation = Level.ProjectElevation(level=mergeByBoolMask_2)
add = mergeByBoolMask + projectElevation
byCoordinates = Point.ByCoordinates(x=code_block_2, y=code_block_2, z=add)
ZAxis = Vector.ZAxis()
byOriginNormal = Plane.ByOriginNormal(origin=byCoordinates, normal=ZAxis)
pullOntoPlane = Curve.PullOntoPlane(curve=code_block.out0, plane=byOriginNormal, lacing=Longest)
VARcurves = Output(pullOntoPlane)
VARmodelcurves = Output(code_block.out1)
