# Dynamo custom node SP.Collector.FamilyInstances.dyf (Dynamo 2.1.0.7500)
# category: Synthesize.Packages.Springs.Revit.Collectors
# Collects placed family instance elements from the document that match the name. Partially mathing elements are collected as well. If no matches are found, a list of all isntance names will be output.

VARinstnaceName = Input(VARinstnaceName: var[])
VARrefresh = Input(VARrefresh: bool = true)
python_script = Python(IN[0]=VARinstnaceName, IN[1]=VARrefresh)
# ---------- python_script.python (39 lines) ----------
#Copyright(c) 2016, Dimitar Venkov
# @5devene, dimitar.ven@gmail.com

import clr

clr.AddReference("RevitServices")
import RevitServices
from RevitServices.Persistence import DocumentManager
doc = DocumentManager.Instance.CurrentDBDocument

clr.AddReference("RevitAPI")
from Autodesk.Revit.DB import *

clr.AddReference("RevitNodes")
import Revit
clr.ImportExtensions(Revit.Elements)

def tolist(obj1):
	if hasattr(obj1,"__iter__"): return obj1
	else: return [obj1]

fn = map(str,tolist(IN[0]) )
result, similar, names = [], [], []

fec = FilteredElementCollector(doc).OfClass(FamilyInstance)
for i in fec:
	n1 = i.Name
	names.append(n1)
	if any(fn1 == n1 for fn1 in fn):
		result.append(i.ToDSType(True))
	elif any(fn1.lower() in n1.lower() for fn1 in fn):
		similar.append(i.ToDSType(True))

if len(result) > 0:
	OUT = result,similar
if len(result) == 0 and len(similar) > 0:
	OUT = "Nothing",similar
if len(result) == 0 and len(similar) == 0:
	OUT = "Nothing", names
# ----------------------------------------
code_block = CodeBlock(o=python_script) { o[0]; o[1]; }
VARexactmatch = Output(code_block.out0)
VARpartialmatch = Output(code_block.out1)
