# Dynamo custom node SP.Doc.CopyFromLinkInstance.dyf (Dynamo 2.1.0.7500)
# category: Synthesize.Packages.Springs.Revit.Document
# The node will use the total transformation of the link instance to copy the input elements into the local document.

VARLinkInstance = Input(VARLinkInstance: var)
VARelement = Input(VARelement: var[])
python_scrpit = Python(IN[0]=VARLinkInstance, IN[1]=VARelement)
# ---------- python_scrpit.python (43 lines) ----------
import clr

clr.AddReference('RevitServices')
from RevitServices.Persistence import DocumentManager
from RevitServices.Transactions import TransactionManager
doc = DocumentManager.Instance.CurrentDBDocument

clr.AddReference('RevitAPI')
from Autodesk.Revit.DB import *

from System.Collections.Generic import List

clr.AddReference('RevitNodes')
import Revit
clr.ImportExtensions(Revit.Elements)

def singleton(x):
	if hasattr(x,'__iter__'): return x[0]
	else : return x

def tolist(x):
	if hasattr(x,'__iter__'): return x
	else : return [x]


linkInst = UnwrapElement(singleton(IN[0]) )
elements = UnwrapElement(tolist(IN[1]) )

linkDoc = linkInst.GetLinkDocument()
tf1 = linkInst.GetTotalTransform()
eId = List[ElementId]()
for e in elements:
	try:
		id1 = e.Id
	except:
		continue
	eId.Add(id1)

TransactionManager.Instance.EnsureInTransaction(doc)
copy = ElementTransformUtils.CopyElements(linkDoc, eId, doc, tf1, None)
TransactionManager.Instance.TransactionTaskDone()

OUT = [doc.GetElement(i).ToDSType(False) for i in copy]
# ----------------------------------------
VARlocalelement = Output(python_scrpit)
