# Dynamo custom node SP.ErrorReport.Parse.dyf (Dynamo 2.1.0.7500)
# category: Synthesize.Automate.Clash Detection
# K-Warnings Read

VARReport = Input(VARReport: var[]..[])
readText = FileSystem.ReadText(file=VARReport)
code_block = CodeBlock { "</p>"; }
split = String.Split(str=readText, separator0=code_block)
lastItem = List.LastItem(list=split)
code_block_2 = CodeBlock { "</tr>"; }
split_2 = String.Split(str=lastItem, separator0=code_block_2)
code_block_3 = CodeBlock { -1; }
dropItems = List.DropItems(list=split_2, amount=code_block_3)
code_block_4 = CodeBlock { ": id"; }
split_3 = String.Split(str=dropItems, separator0=code_block_4)
firstItem = List.FirstItem(list=split_3@L2)
string = StringInput("<td style=\"vertical-align:top;\">")  # graph input
split_4 = String.Split(str=firstItem@L2, separator0=string)
lastItem_2 = List.LastItem(list=split_4@L2)
code_block_5 = CodeBlock { "</td>"; }
split_5 = String.Split(str=lastItem_2@L2, separator0=code_block_5)
firstItem_2 = List.FirstItem(list=split_5@L2)
trimWhitespace = String.TrimWhitespace(str=firstItem_2)
python_null_2_empty = Custom[Python Null 2 Empty](VARIN=trimWhitespace)  # Python Null 2 Empty
VARWarnings = Output(python_null_2_empty)
code_block_6 = CodeBlock { 1; }
dropItems_2 = List.DropItems(list=split_3@L2, amount=code_block_6)
trimWhitespace_2 = String.TrimWhitespace(str=dropItems_2)
code_block_7 = CodeBlock { " "; 0; }
indexOf = String.IndexOf(str=trimWhitespace_2, searchFor=code_block_7.out0)
substring = String.Substring(str=trimWhitespace_2, startIndex=code_block_7.out1, length=indexOf)
toNumber = String.ToNumber(str=substring)
simple_byelement_id_selection = Custom[Simple ByElement Id Selection](VARId=toNumber)  # Simple ByElement Id Selection
python_null_2_empty_2 = Custom[Python Null 2 Empty](VARIN=simple_byelement_id_selection)
VARElements = Output(python_null_2_empty_2)
