# Dynamo custom node SP.FamilyInstance.ByGeometry.dyf (Dynamo 2.1.0.7500)
# category: Synthesize.Packages.Springs.Revit.FamilyInstance
# You must provide a valid family template path that will be used for all input geometry objects. The project units(and not the templates) will be used to determine the size of the output geometry.
# The provided category will be used only if the family template supports it. If not, the default template category will be used instead.
# Likewise, the family material(provided as a string) will be set only if a material with that name exists in the template. If not, the default material will be used instead ("By Category").
# For void cuts, the material settings will be ignored.
# The Subcategory name is an optional input. If you'd like to skip assigning a Subcategory to any new instance, simply use null.
# The node expects a unique family name for each geometry object. The rest of the input lists will be processed as if the node lacing is set to longest.

VARgeometry = Input(VARgeometry: var[])
VARfamilyTemplatePath = Input(VARfamilyTemplatePath: var)
VARfamilyName = Input(VARfamilyName: var[])
python_script = Python(IN[0]=VARfamilyName, IN[1]=VARgeometry)
# ---------- python_script.python (96 lines) ----------
# Created By Karam Baki, karam@aecedx.com
import clr
import System
from System.Collections.Generic import *

from itertools import repeat

pf_path = System.Environment.GetFolderPath(System.Environment.SpecialFolder.ProgramFilesX86)
import sys
sys.path.append('%s\IronPython 2.7\Lib' %pf_path)
import traceback

clr.AddReference('ProtoGeometry')
from Autodesk.DesignScript.Geometry import *
from Autodesk.DesignScript.Geometry import Point as DynPoint
from Autodesk.DesignScript.Geometry import Line as DynLine
from Autodesk.DesignScript.Geometry import Curve as DynCurve

clr.AddReference('RevitServices')
import RevitServices
from RevitServices.Persistence import DocumentManager
from RevitServices.Transactions import TransactionManager
doc = DocumentManager.Instance.CurrentDBDocument

clr.AddReference('RevitAPI')
from Autodesk.Revit.DB import *
from Autodesk.Revit.DB.Structure import StructuralType

clr.AddReference('RevitNodes')
import Revit
clr.ImportExtensions(Revit.Elements)
clr.ImportExtensions(Revit.GeometryConversion)
# Choose The Current Document
doc = DocumentManager.Instance.CurrentDBDocument
uidoc = DocumentManager.Instance.CurrentUIApplication.ActiveUIDocument
uiapp = DocumentManager.Instance.CurrentUIApplication
app = uiapp.Application

def toList(input):
	if isinstance(input,list) == False:
		return [input]
	else:
		return input

#Family symbol name to place.
famnames = UnwrapElement(toList(IN[0]))
check = IN[1]

cleanlist = ["Dynamo Wall Intersects Family","Dynamo K-Paneling","Dynamo Solid or Void Family","Dynamo Splitted Mass","Dynamo Converted Element","Dynamo Converted Face","Dynamo Loft Family","Dynamo Scaled Mass","Dynamo Generated Patch","Dynamo Sliced Pieces","Dynamo Chamfered Element","Dynamo Filleted Element","Dynamo Stairs K-Fill"]

if check != None and check != []:
	#create a filtered element collector set to Category OST_Mass and Class FamilySymbol 
	collector = FilteredElementCollector(doc)
	collector.OfClass(FamilySymbol)
	famtypeitr = collector.GetElementIterator()
	fec = FilteredElementCollector(doc).OfClass(FamilyInstance)
	names = []
	for ff in fec:
		names.append(ff.Name)
	
	todel = []
	toclean = []
	for item in famtypeitr:
		for f in famnames:
			if f in item.FamilyName:
				famtype = item
				if f in names:
					break
				famId = item.Family.Id
				todel.append(famId)
				break
		for clean in cleanlist:
			if clean in item.FamilyName and item.FamilyName not in famnames:
				toclean.append(item.Family)
				
	if len(toclean) != 0 or len(todel) !=0:
		TransactionManager.Instance.EnsureInTransaction(doc)
		if len(todel) != 0:
			for t in todel:
				try:
					doc.Delete(t)
				except:
					pass
		if len(toclean) != 0:
			for c in toclean:
				elements = [x for x in FilteredElementCollector(doc).OfClass(FamilyInstance).ToElements() if c.Name in x.Symbol.FamilyName]
				if elements == []:
					try:
						doc.Delete(c.Id)
					except:
						pass
		TransactionManager.Instance.TransactionTaskDone()
	
	OUT = famnames
else:
	OUT = famnames
# ----------------------------------------
VARcategory = Input(VARcategory: var[] = Revit.Elements.Category.ByName("OST_GenericModel"))
VARmaterialName = Input(VARmaterialName: var[] = null)
VARisVoid = Input(VARisVoid: var[] = false)
VARsubcategoryName = Input(VARsubcategoryName: var[] = null)
VARisShared = Input(VARisShared: var[] = null)
VARPlaceInstance = Input(VARPlaceInstance: bool[] = true)
VARPositionSystemFalseIsInstanceOriginTr = Input(VARPositionSystemFalseIsInstanceOriginTrueRelativeToProjectOrigin: bool[] = false)
VARonemat = Input(VARonemat: bool[] = false)
VARIsInstanceMat = Input(VARIsInstanceMat: bool[] = true)
python_script_2 = Python(IN[0]=VARgeometry, IN[1]=VARfamilyTemplatePath, IN[2]=python_script, IN[3]=VARcategory, IN[4]=VARmaterialName, IN[5]=VARisVoid, IN[6]=VARsubcategoryName, IN[7]=VARisShared, IN[8]=VARPlaceInstance, IN[9]=VARPositionSystemFalseIsInstanceOriginTr, IN[10]=VARonemat, IN[11]=VARIsInstanceMat)
# ---------- python_script_2.python (595 lines) ----------
#Copyright(c) 2016, Dimitar Venkov
# @5devene, dimitar.ven@gmail.com
# Modified & Improved By Karam Baki, karam@aecedx.com
import clr
import System
from System.Collections.Generic import *

from itertools import repeat

pf_path = System.Environment.GetFolderPath(System.Environment.SpecialFolder.ProgramFilesX86)
import sys
sys.path.append('%s\IronPython 2.7\Lib' %pf_path)
import traceback

clr.AddReference('ProtoGeometry')
from Autodesk.DesignScript.Geometry import *
from Autodesk.DesignScript.Geometry import Point as DynPoint
from Autodesk.DesignScript.Geometry import Line as DynLine
from Autodesk.DesignScript.Geometry import Curve as DynCurve

clr.AddReference('RevitServices')
import RevitServices
from RevitServices.Persistence import DocumentManager
from RevitServices.Transactions import TransactionManager
doc = DocumentManager.Instance.CurrentDBDocument

clr.AddReference('RevitAPI')
from Autodesk.Revit.DB import *
from Autodesk.Revit.DB.Structure import StructuralType

clr.AddReference('RevitNodes')
import Revit
clr.ImportExtensions(Revit.Elements)
clr.ImportExtensions(Revit.GeometryConversion)

import random
import string

def random_char(y):
       return ''.join(random.choice(string.ascii_letters) for x in range(y))

def tolist(obj1):
	if hasattr(obj1,'__iter__'): return obj1
	else: return [obj1]

def output1(l1):
	if len(l1) == 1: return l1[0]
	else: return l1

def PadLists(lists):
	len1 = len(lists[0])
	for i in xrange(1,len(lists)):
		len2 = len(lists[i])
		if len2 == len1 : continue
		elif len2 > len1: lists[i] = lists[i][:len1]
		else : lists[i].extend(repeat(lists[i][-1],len1 - len2))
	return lists
	
def flatten(x):
    result = []
    for el in x:
        if hasattr(el, "__iter__") and not isinstance(el, basestring):
            result.extend(flatten(el))
        else:
            result.append(el)
    return result
    
def freeformfromimportinstance(famdoc,importedelement,opt1):
	#opt1 = Options()
	#opt1.ComputeReferences = True
	geom = importedelement.get_Geometry(opt1)
	geomfix = []
	for e in geom:
		go = e.GetInstanceGeometry()
		for g in go:
			t1.EnsureInTransaction(famdoc)
			geomfix.append(FreeFormElement.Create(famdoc,g))
			TransactionManager.ForceCloseTransaction(t1)
	return geomfix

def freesat(sat_path,famdoc,s1,doc):
		t1 = TransactionManager.Instance
		t1.EnsureInTransaction(famdoc)
		shapeImporter = ShapeImporter()
		inputsat = ShapeImporterSourceFormat.SAT
		converted = shapeImporter.Convert(famdoc, sat_path)
		togolist = []
		for e in converted:
			try:
				togolist.append(FreeFormElement.Create(famdoc,e))
			except:
				try:
					for to in togolist:
						famdoc.Delete(to.Id)
					togolist = []
				except:
					pass
				break
		shapeImporter.Dispose()
		TransactionManager.ForceCloseTransaction(t1)
		if len(togolist) == 0:
			s1 = tolist(s1)
			opt1 = Options()
			opt1.ComputeReferences = True
			for xx in s1:
				try:
					Revit.Transaction.Transaction.Start(famdoc)
					satopt1 = SATImportOptions()
					importedelement = doc.GetElement(doc.Import(sat_path, satopt1, doc.ActiveView))
					importedelement.Pinned = False
					Revit.Transaction.Transaction.End(famdoc)
					from Autodesk.DesignScript import Geometry as dg					
					triggers = []
					kgeom = importedelement.get_Geometry(opt1)
					centkgeomfix = []
					kgeomfix = []
					for ke in kgeom:
						kgo = ke.GetInstanceGeometry()
						for kg in kgo:
							try:
								centkgeomfix.append(kg.ComputeCentroid().ToPoint())
							except:
								centkgeomfix.append(None)
							kgeomfix.append(kg)
					try:
						cenmin = xx.Centroid()
						cenminelem = centkgeomfix[0]
						if dg.Geometry.DistanceTo(cenminelem,cenmin) > 0.2:
							triggers.append(True)
						else:
							triggers.append(False)
					except:
						pass
					try:
						bboxorig = dg.BoundingBox.ByGeometry(xx)
						elembbox = importedelement.get_BoundingBox(None).ToProtoType()
						zmin = bboxorig.MinPoint
						zminelem = elembbox.MinPoint
						zmax = bboxorig.MaxPoint
						zmaxelem = elembbox.MaxPoint
						if dg.Geometry.DistanceTo(zminelem,zmin) > 0.2 and dg.Geometry.DistanceTo(zmaxelem,zmax) > 0.2:
							triggers.append(True)
						else:
							triggers.append(False)
						if all(triggers):
							midelem = kgeomfix[0].GetBoundingBox().Transform.Origin.ToPoint()
							mid = dg.Curve.PointAtParameter(dg.Line.ByStartPointEndPoint(bboxorig.MinPoint,bboxorig.MaxPoint),0.5)
							if dg.Geometry.DistanceTo(midelem,mid) > 0.2:
								line = dg.Line.ByStartPointEndPoint(midelem,mid)
								tran = dg.Geometry.Transform(line,dg.CoordinateSystem.ByOrigin(line.StartPoint),dg.CoordinateSystem.ByOrigin(0,0,0)).EndPoint.ToXyz()
								TransactionManager.Instance.EnsureInTransaction(doc)
								importedelement.Location.Move(tran)
								TransactionManager.Instance.TransactionTaskDone()
								TransactionManager.ForceCloseTransaction(t1)
					except:
						pass
					togolist.append(freeformfromimportinstance(famdoc,importedelement,opt1))
					TransactionManager.Instance.EnsureInTransaction(doc)
					doc.Delete(importedelement.Id)
					TransactionManager.Instance.TransactionTaskDone()
					TransactionManager.ForceCloseTransaction(t1)
				except:
					pass
		return togolist

class FamOpt1(IFamilyLoadOptions):
	def __init__(self):
		pass
	def OnFamilyFound(self,familyInUse, overwriteParameterValues):
		return True
	def OnSharedFamilyFound(self,familyInUse, source, overwriteParameterValues):
		return True

geom = IN[0]
if geom != None:
	geom = tolist(geom)
else:
	pass
fam_path = IN[1]
names = tolist(IN[2])
category = tolist(IN[3])
material = tolist(IN[4])
isVoid = tolist(IN[5])
subcat = tolist(IN[6])
isShared = tolist(IN[7])
placeInstance = tolist(IN[8])
positionSystem = tolist(IN[9])
onemat = tolist(IN[10])
instancemat = tolist(IN[11])

newlist = []
for e in category:
	try:
		newlist.append(Revit.Elements.Category.ByName(e))
	except:
		newlist.append(e)
category = newlist

try:
	fami = Revit.Elements.Family.ByName(names[0])
except:
	fami = None
fami = UnwrapElement(fami)

if int(DocumentManager.Instance.CurrentUIApplication.Application.VersionNumber) < 2021:
	units = doc.GetUnits().GetFormatOptions(UnitType.UT_Length).DisplayUnits
	factor = UnitUtils.ConvertToInternalUnits(1,units)
else:
	factor = UnitUtils.ConvertToInternalUnits(1,doc.GetUnits().GetFormatOptions(SpecTypeId.Length).GetUnitTypeId())
acceptable_views = ('ThreeD', 'FloorPlan', 'EngineeringPlan', 'CeilingPlan', 'Elevation', 'Section')
origin = XYZ.Zero
str_typ = StructuralType.NonStructural
t1 = TransactionManager.Instance
temp_path = System.IO.Path.GetTempPath()
invalid_chars = System.IO.Path.GetInvalidFileNameChars()
satOpt = SATImportOptions()
satOpt.Placement = ImportPlacement.Origin
satOpt.Unit = ImportUnit.Foot
opt1 = Options()
opt1.ComputeReferences = True
SaveAsOpt = SaveAsOptions()
SaveAsOpt.OverwriteExistingFile = True


def NewForm_background(s1, name1, cat1, isVoid1, mat1, subcat1, isShared1, placeInstance1, positionSystem1, onemat1, instancemat1):
	if mat1 == None or mat1 == "":
		mat1 = "Default"
	if doc.IsFamilyDocument == True and cat1.Name != "Mass":
		if (doc.OwnerFamily.FamilyCategory).Name == "Mass":
			isShared1 = True
			namesplit = name1.split(" ")
			namenum = namesplit.pop(-1)
			namesplit.append(random_char(5))
			namesplit.append(namenum)
			joined = " ".join(namesplit)
			name1 = "In Mass " + joined
	if isShared1:
		name1 = "Shared " + name1
	if cat1.Name == "Mass" and (subcat1 == "" or subcat1 == None):
		subcat1 = "Form"
	if cat1.Name == "Mass":
		mat1 = None
	if doc.IsFamilyDocument == False and cat1.Name == "Mass":
		positionSystem1 = True
		try:
			if mat1 == None or mat1 == "":
				enable_mat = False
			else:
				enable_mat = True
				
			if subcat1 == None or subcat1 == "":
				enable_subcat = False
			else:
				enable_subcat = True
	
			if any( (c in name1 for c in invalid_chars) ):
				raise Exception('Family name contains invalid characters')
			TransactionManager.ForceCloseTransaction(t1)
			famdoc = doc.Application.NewFamilyDocument(fam_path)
			if fami == None:
				BIGfamdoc = doc.Application.NewFamilyDocument(fam_path)
			else:
				BIGfamdoc = doc.EditFamily(fami)
			sat_path = '%s%s.sat' % (temp_path, name1)
			if factor != 1:
			    tlist = []
			    for each in s1:
			    	#tlist.append(each.Scale(factor))
			    	tlist.append(each)
				s1 = tlist
			if positionSystem1 == False:
				bbox = BoundingBox.ByGeometry(s1)
				Minploc = bbox.MinPoint
				Maxploc = bbox.MaxPoint
				MAX_X = Maxploc.X
				MAX_Y = Maxploc.Y
				min_Z = Minploc.Z
				NEWMAX = DynPoint.ByCoordinates(MAX_X,MAX_Y,min_Z)
				linebet = DynLine.ByStartPointEndPoint(Minploc,NEWMAX)
				locpoint = DynCurve.PointAtParameter(linebet,0.5)
				vec1 = Vector.ByTwoPoints(locpoint, DynPoint.Origin())
				tlist = []
				for each in s1:
					tlist.append(each.Translate(vec1))
				s1 = tlist
			sat1 = Geometry.ExportToSAT(s1, sat_path)
			view_fec = FilteredElementCollector(famdoc).OfClass(View)
			view1 = None
			for v in view_fec:
				if str(v.ViewType) in acceptable_views and not v.IsTemplate:
					view1 = v
					break
			t1.EnsureInTransaction(famdoc)
			save_path = '%s%s.rfa' % (temp_path, "Inside " + name1)
			try: #set the category
				fam_cat = famdoc.Settings.Categories.get_Item(cat1.Name)
				famdoc.OwnerFamily.FamilyCategory = fam_cat
			except: pass

			BIGsave_path = '%s%s.rfa' % (temp_path, name1)
			try: #set the category
				fam_cat = famdoc.Settings.Categories.get_Item(cat1.Name)
				famdoc.OwnerFamily.FamilyCategory = fam_cat
			except: pass
			TransactionManager.ForceCloseTransaction(t1)
			sall = flatten(freesat(sat1,famdoc,s1,doc))
			System.IO.File.Delete(sat_path)
			if len(sall) < 2:
				onemat1 = True
			t1.EnsureInTransaction(famdoc)
			#for seach in s1:
			matcount = 1
			for s2 in sall:
				if isVoid1:
					void_par = s2.get_Parameter(BuiltInParameter.ELEMENT_IS_CUTTING).Set(1)
					void_par2 = famdoc.OwnerFamily.get_Parameter(BuiltInParameter.FAMILY_ALLOW_CUT_WITH_VOIDS).Set(1)
					if isShared1:
						try:
							shared_par = famdoc.OwnerFamily.get_Parameter(BuiltInParameter.FAMILY_SHARED).Set(1)
						except: pass
				else: #voids do not have a material values or a sub-cateogry
					try:
						famdoc.FamilyManager.NewType("Inside " + name1)
					except: pass
					if enable_mat:
						try:
							if onemat1 == False:
								matname = "Material " + str(matcount)
							else:
								matname = "Material"
							try:
								if instancemat1 == True:
									famnewpar = famdoc.FamilyManager.AddParameter(matname,BuiltInParameterGroup.PG_MATERIALS,ParameterType.Material,True)
								else:
									famnewpar = famdoc.FamilyManager.AddParameter(matname,BuiltInParameterGroup.PG_MATERIALS,ParameterType.Material,False)
							except:
								pass
							mat_fec = FilteredElementCollector(famdoc).OfClass(Material)
							fam_mat = False
							for m in mat_fec:
								if m.Name.lower() == mat1.lower():
									fam_mat = m.Id
									break
							if fam_mat == False:
								newmat = Material.Create(famdoc, mat1)
								defcolor = Color(120,120,120)
								famdoc.GetElement(newmat).Color = defcolor
								fam_mat = newmat
							famdoc.FamilyManager.AssociateElementParameterToFamilyParameter(s2.get_Parameter(BuiltInParameter.MATERIAL_ID_PARAM), famnewpar)
							famdoc.FamilyManager.Set(famnewpar,fam_mat)
							if onemat1 == False:
								matcount = matcount + 1
							else:
								pass
						except:	pass
					if enable_subcat: #create and assign the sub-category:
						try:
							current_fam_cat = famdoc.OwnerFamily.FamilyCategory
							sub_fec = current_fam_cat.SubCategories
							sub_cat = False
							for sub in sub_fec:
								if sub.Name.lower() == subcat1.lower():
									sub_cat = sub
									break
							if sub_cat == False:
								newsubcat = famdoc.Settings.Categories.NewSubcategory(current_fam_cat, subcat1)
								sub_cat = newsubcat					
							s2.Subcategory = sub_cat
						except: pass
					if isShared1:
						try:
							shared_par = famdoc.OwnerFamily.get_Parameter(BuiltInParameter.FAMILY_SHARED).Set(1)
						except: pass
			TransactionManager.ForceCloseTransaction(t1)
			famdoc.SaveAs(save_path, SaveAsOpt)
			if fami == None:
				BIGfamdoc.SaveAs(BIGsave_path, SaveAsOpt)
			BIGLoad = famdoc.LoadFamily(BIGfamdoc, FamOpt1() )
			symbols = BIGLoad.GetFamilySymbolIds().GetEnumerator()
			symbols.MoveNext()
			symbol1 = BIGfamdoc.GetElement(symbols.Current)
			t1.EnsureInTransaction(BIGfamdoc)
			if not symbol1.IsActive: symbol1.Activate()
			if fami == None:
				inst1 = BIGfamdoc.FamilyCreate.NewFamilyInstance(origin, symbol1, str_typ)
			if positionSystem1 == False and fami == None:
				ElementTransformUtils.MoveElement(doc,inst1.Id, vec1.Reverse().ToXyz())
			TransactionManager.ForceCloseTransaction(t1)
			family1 = BIGfamdoc.LoadFamily(doc, FamOpt1() )
			famdoc.Close(False)
			BIGfamdoc.Close(False)
			System.IO.File.Delete(save_path)
			if fami == None:
				System.IO.File.Delete(BIGsave_path)
			symbols = family1.GetFamilySymbolIds().GetEnumerator()
			symbols.MoveNext()
			symbol1 = doc.GetElement(symbols.Current)
			if placeInstance1 == True:
				t1.EnsureInTransaction(doc)
				if not symbol1.IsActive: symbol1.Activate()
				if doc.IsFamilyDocument == True:
					inst1 = doc.FamilyCreate.NewFamilyInstance(origin, symbol1, str_typ)
				else:
					inst1 = doc.Create.NewFamilyInstance(origin, symbol1, str_typ)
				if positionSystem1 == False:
					ElementTransformUtils.MoveElement(doc,inst1.Id, vec1.Reverse().Scale(factor).ToXyz())
				TransactionManager.ForceCloseTransaction(t1)
				return inst1.ToDSType(False), family1.ToDSType(False)
			else:
				inst1 = []
				return inst1, family1.ToDSType(False)
			
		except:
			try:
				famdoc.Close(False)
				BIGfamdoc.Close(False)
			except: pass
			return traceback.format_exc(),''
	else:
		try:
			if mat1 == None or mat1 == "":
				enable_mat = False
			else:
				enable_mat = True
				
			if subcat1 == None or subcat1 == "":
				enable_subcat = False
			else:
				enable_subcat = True

			if any( (c in name1 for c in invalid_chars) ):
				raise Exception('Family name contains invalid characters')
			TransactionManager.ForceCloseTransaction(t1)
			famdoc = doc.Application.NewFamilyDocument(fam_path)
			sat_path = '%s%s.sat' % (temp_path, name1)
			if factor != 1:
			    tlist = []
			    for each in s1:
			    	#tlist.append(each.Scale(factor))
			        tlist.append(each)
				s1 = tlist
			if positionSystem1 == False:
				bbox = BoundingBox.ByGeometry(s1)
				Minploc = bbox.MinPoint
				Maxploc = bbox.MaxPoint
				MAX_X = Maxploc.X
				MAX_Y = Maxploc.Y
				min_Z = Minploc.Z
				NEWMAX = DynPoint.ByCoordinates(MAX_X,MAX_Y,min_Z)
				linebet = DynLine.ByStartPointEndPoint(Minploc,NEWMAX)
				locpoint = DynCurve.PointAtParameter(linebet,0.5)
				vec1 = Vector.ByTwoPoints(locpoint, DynPoint.Origin())
				tlist = []
				for each in s1:
					tlist.append(each.Translate(vec1))
				s1 = tlist
			#sat1 = Geometry.ExportToSAT(s1, sat_path)
			view_fec = FilteredElementCollector(famdoc).OfClass(View)
			view1 = None
			for v in view_fec:
				if str(v.ViewType) in acceptable_views and not v.IsTemplate:
					view1 = v
					break
			t1.EnsureInTransaction(famdoc)
			save_path = '%s%s.rfa' % (temp_path, name1)
			try: #set the category
				fam_cat = famdoc.Settings.Categories.get_Item(cat1.Name)
				famdoc.OwnerFamily.FamilyCategory = fam_cat
			except: pass
			TransactionManager.ForceCloseTransaction(t1)
			sall = []
			for s1in in s1:
				sat1 = Geometry.ExportToSAT(s1in, sat_path)
				sall.append(flatten(freesat(sat1,famdoc,[s1in],doc)))
				System.IO.File.Delete(sat_path)
			sall = flatten(sall)
			if len(sall) < 2:
				onemat1 = True
			t1.EnsureInTransaction(famdoc)
			matcount = 1
			for s2 in sall:
				if isVoid1:
					void_par = s2.get_Parameter(BuiltInParameter.ELEMENT_IS_CUTTING).Set(1)
					void_par2 = famdoc.OwnerFamily.get_Parameter(BuiltInParameter.FAMILY_ALLOW_CUT_WITH_VOIDS).Set(1)
					if isShared1:
						try:
							shared_par = famdoc.OwnerFamily.get_Parameter(BuiltInParameter.FAMILY_SHARED).Set(1)
						except: pass
				else: #voids do not have a material values or a sub-cateogry
					try:
						famdoc.FamilyManager.NewType(name1)
					except : pass
					if enable_mat:
						try:
							if onemat1 == False:
								matname = "Material " + str(matcount)
							else:
								matname = "Material"
							try:
								if instancemat1 == True:
									famnewpar = famdoc.FamilyManager.AddParameter(matname,BuiltInParameterGroup.PG_MATERIALS,ParameterType.Material,True)
								else:
									famnewpar = famdoc.FamilyManager.AddParameter(matname,BuiltInParameterGroup.PG_MATERIALS,ParameterType.Material,False)
							except:
								pass
							mat_fec = FilteredElementCollector(famdoc).OfClass(Material)
							fam_mat = False
							for m in mat_fec:
								if m.Name.lower() == mat1.lower():
									fam_mat = m.Id
									break
							if fam_mat == False:
								newmat = Material.Create(famdoc, mat1)
								defcolor = Color(120,120,120)
								famdoc.GetElement(newmat).Color = defcolor
								fam_mat = newmat
							famdoc.FamilyManager.AssociateElementParameterToFamilyParameter(s2.get_Parameter(BuiltInParameter.MATERIAL_ID_PARAM), famnewpar)
							famdoc.FamilyManager.Set(famnewpar,fam_mat)
							if onemat1 == False:
								matcount = matcount + 1
							else:
								pass
						except:	pass
						try:
							famdoc.FamilyManager.SortParameters(ParametersOrder.Ascending)
						except:
							pass
					if enable_subcat: #create and assign the sub-category:
						try:
							current_fam_cat = famdoc.OwnerFamily.FamilyCategory
							sub_fec = current_fam_cat.SubCategories
							sub_cat = False
							for sub in sub_fec:
								if sub.Name.lower() == subcat1.lower():
									sub_cat = sub
									break
							if sub_cat == False:
								newsubcat = famdoc.Settings.Categories.NewSubcategory(current_fam_cat, subcat1)
								sub_cat = newsubcat					
							s2.Subcategory = sub_cat
						except: pass
					if isShared1:
						try:
							shared_par = famdoc.OwnerFamily.get_Parameter(BuiltInParameter.FAMILY_SHARED).Set(1)
						except: pass
			TransactionManager.ForceCloseTransaction(t1)
			famdoc.SaveAs(save_path, SaveAsOpt)
			family1 = famdoc.LoadFamily(doc, FamOpt1() )
			famdoc.Close(False)
			System.IO.File.Delete(save_path)
			symbols = family1.GetFamilySymbolIds().GetEnumerator()
			symbols.MoveNext()
			symbol1 = doc.GetElement(symbols.Current)
			if placeInstance1 == True:
				t1.EnsureInTransaction(doc)
				if not symbol1.IsActive: symbol1.Activate()
				if doc.IsFamilyDocument == True:
					inst1 = doc.FamilyCreate.NewFamilyInstance(origin, symbol1, str_typ)
				else:
					inst1 = doc.Create.NewFamilyInstance(origin, symbol1, str_typ)
				if positionSystem1 == False:
					ElementTransformUtils.MoveElement(doc,inst1.Id, vec1.Reverse().Scale(factor).ToXyz())
				TransactionManager.ForceCloseTransaction(t1)
				return inst1.ToDSType(False), family1.ToDSType(False)
			else:
				inst1 = []
				return inst1, family1.ToDSType(False)
		
		except:
			try:
				TransactionManager.ForceCloseTransaction(t1)
				famdoc.Close(False)
			except: pass
			return traceback.format_exc(),''

result = []

if geom == None or len(geom) == 0:
	OUT = None
else:
	if len(geom) == len(names):
		glist = []
		for each in geom:
			glist.append([each])
		geom = glist
		padded = PadLists([geom, category, isVoid, material, subcat, isShared, placeInstance, positionSystem, onemat, instancemat])
		p_category, p_isVoid, p_material, p_subcat, p_isShared, p_placeInstance, p_positionSystem, p_onemat, p_instancemat = padded[1], padded[2], padded[3], padded[4], padded[5], padded[6], padded[7], padded[8], padded[9]
		return1 = map(NewForm_background, geom, names, p_category, p_isVoid, p_material, p_subcat, p_isShared, p_placeInstance, p_positionSystem, p_onemat, p_instancemat)
		result = output1([i[0] for i in return1]), output1([i[1] for i in return1])
	else :
		result = NewForm_background(geom, names[0], category[0], isVoid[0], material[0], subcat[0], isShared[0],  placeInstance[0], positionSystem[0], onemat[0], instancemat[0])
	OUT = result
	satOpt.Dispose()
	opt1.Dispose()
	SaveAsOpt.Dispose()
# ----------------------------------------
code_block = CodeBlock(res=python_script_2) { res[0]; res[1]; }
VARinstance = Output(code_block.out0)
VARfamily = Output(code_block.out1)
