# Dynamo custom node SP.Filter.ByCategoryName.dyf (Dynamo 2.1.0.7500)
# category: Synthesize.Packages.Springs.Revit.Utility
# Filters the input elements by their category name. You can input multiple category names.

VARelement = Input(VARelement: var[])
VARcategoryName = Input(VARcategoryName: var[])
python_script = Python(IN[0]=VARelement, IN[1]=VARcategoryName)
# ---------- python_script.python (24 lines) ----------
#Copyright(c) 2016, Dimitar Venkov
# @5devene, dimitar.ven@gmail.com

import clr

clr.AddReference("RevitNodes")
import Revit
clr.ImportExtensions(Revit.Elements)

def tolist(obj1):
	if hasattr(obj1,"__iter__"): return obj1
	else: return [obj1]

elements = UnwrapElement(tolist(IN[0]))
filter = tolist(IN[1])
in1, out1 = [], []

for i in xrange(len(elements)):
	try: n1 = elements[i].Category.Name.lower()
	except: n1 = ""
	if any(filter[j].lower() in n1 for j in xrange(len(filter))):
		in1.append(elements[i])
	else: out1.append(elements[i])
OUT = in1, out1
# ----------------------------------------
code_block = CodeBlock(f=python_script) { f[0]; f[1]; }
VARin = Output(code_block.out0)
VARout = Output(code_block.out1)
