# Dynamo custom node SP.Filter.ByClassName.dyf (Dynamo 2.1.0.7500)
# category: Synthesize.Packages.Springs.Core.Object.Actions
# Filters a list of objects by the object's class name. Note that Dynamo elements belong to different classes than their Revit counterparts. Use the Object.Class node to check an object's class.

VARobject = Input(VARobject: var[])
code_block = CodeBlock { false; }
clean = List.Clean(list=VARobject, preserveIndices=code_block)
type = Object.Type(obj=clean)
toLower = String.ToLower(str=type)
VARclassName = Input(VARclassName: var[])
toLower_2 = String.ToLower(str=VARclassName)
code_block_2 = CodeBlock { true; }
contains = String.Contains(str=toLower, searchFor=toLower_2, ignoreCase=code_block_2, lacing=Longest)
filterByBoolMask = List.FilterByBoolMask(list=clean, mask=contains)
VARin = Output(filterByBoolMask.in)
VARout = Output(filterByBoolMask.out)
VARbool = Output(contains)
