# Dynamo custom node SP.FloorOpening.ByCurves.dyf (Dynamo 2.13.1.3887)
# category: Synthesize.Packages.Springs.Revit.Opening
# Create hosted floor opeinngs through the input floors. The second input is a list of sub-lists of the boundary curves.

VARhost = Input(VARhost: var[])
VARcurves = Input(VARcurves: var[][])
python_script = Python(IN[0]=VARhost, IN[1]=VARcurves)  # IronPython2
# ---------- python_script.python (66 lines) ----------
# Copyright(c) 2016, Dimitar Venkov
# @5devene, dimitar.ven@gmail.com
# Enhanced by Karam Baki, karam@aecedx.com

import clr

clr.AddReference("RevitAPI")
from Autodesk.Revit.DB import *

clr.AddReference("RevitServices")
import RevitServices
from RevitServices.Persistence import DocumentManager
from RevitServices.Transactions import TransactionManager
doc =  DocumentManager.Instance.CurrentDBDocument

clr.AddReference("RevitNodes")
import Revit
clr.ImportExtensions(Revit.Elements)
clr.ImportExtensions(Revit.GeometryConversion)

def tolist(obj1):
	if hasattr(obj1,"__iter__"): return obj1
	else: return [obj1]

flr = UnwrapElement(tolist(IN[0]) )
hole = UnwrapElement(IN[1])

openings = []
newhl = []

if not any(hasattr(h,"__iter__") for h in hole):
	hole = [hole]
TransactionManager.Instance.EnsureInTransaction(doc)
for i in xrange(len(hole)):
	z = CurveArray()
	[z.Append(j.ToRevitType()) for j in hole[i] ]
	newhl.append(z)
if len(flr) == 1 :
	for i in xrange(len(newhl)):
		try:
			try:
				x = doc.Create.NewOpening(flr[0],newhl[i],False)
			except:
				for n in range(newhl[i].Size):
					tmpCurveArray = CurveArray()
					[tmpCurveArray.Append(j.ToNurbsCurve().ToRevitType()) for j in hole[i] ]
				x = doc.Create.NewOpening(flr[0],tmpCurveArray,False)
			openings.append(x.ToDSType(False))
		except:
			openings.append(None)
else:
	count = 0
	for f, h in zip(flr, newhl):
		try:
			try:
				x = doc.Create.NewOpening(f,h,False)
			except:
				tmpCurveArray = CurveArray()
				[tmpCurveArray.Append(j.ToNurbsCurve().ToRevitType()) for j in hole[count] ]
				x = doc.Create.NewOpening(f,tmpCurveArray,False)
			openings.append(x.ToDSType(False))
		except:
			openings.append(None)
		count += 1
TransactionManager.Instance.TransactionTaskDone()
OUT = openings
# ----------------------------------------
VARopening = Output(python_script)
