# Dynamo custom node SP.List.DropFirstLast.dyf (Dynamo 2.1.0.7500)
# category: Synthesize.Packages.Springs.Core.List
# Removes the first and last items from the list

VARlist = Input(VARlist: var[]..[])
code_block = CodeBlock(l1=VARlist) { DSCore.List.DropItems(DSCore.List.DropItems(l1,1),-1); l1[[0,-1]]; }
VARlist_2 = Output(code_block.out0)  # "VARlist"
VARFirstLast = Output(code_block.out1)
