# Dynamo custom node SP.List.ItemAtIndex+.dyf (Dynamo 2.1.0.7500)
# category: Synthesize.Packages.Springs.Core.List
# Identical to the built in node but works with negative indices

VARlist = Input(VARlist: var[]..[])
VARindex = Input(VARindex: var[])
code_block = CodeBlock(items=VARlist, idx=VARindex) { items[idx]; }
VARitem = Output(code_block)
