# Dynamo custom node SP.List.MergeByBoolMask.dyf (Dynamo 2.1.0.7500)
# category: Synthesize.Packages.Springs.Core.List
# Merge two lists by a boolean mask list. The true count in the mask should be the same as the length of the true list and vice versa for the false list.

VARmask = Input(VARmask: var[]..[])
VARIn = Input(VARIn: var[]..[])
VAROut = Input(VAROut: var[]..[])
python_script = Python(IN[0]=VARmask, IN[1]=VARIn, IN[2]=VAROut)
# ---------- python_script.python (13 lines) ----------
#Copyright(c) 2016, Dimitar Venkov
# @5devene, dimitar.ven@gmail.com

def tolist(obj1):
	if hasattr(obj1,'__iter__'): return obj1
	else: return [obj1]

t1 = tolist(IN[0])
l1 = tolist(IN[1])
l2 = tolist(IN[2])

try: OUT = [l1.pop(0) if i else l2.pop(0) for i in t1]
except: OUT = 'List mismatch.'
# ----------------------------------------
VARlist = Output(python_script)
