# Dynamo custom node SP.List.Subpairs.dyf (Dynamo 2.1.0.7500)
# category: Synthesize.Packages.Springs.Core.List
# Pair up each list item with the next one and drop the list item.

VARlist = Input(VARlist: var[]..[])
code_block = CodeBlock(l1=VARlist)
# ---------- code_block.designscript (2 lines) ----------
DSCore.List.DropItems(DSCore.
List.Sublists(l1,0..1,1),-1);
# ----------------------------------------
VARlists = Output(code_block)
