# Dynamo custom node SP.Mesh.ToPolySurface.dyf (Dynamo 2.1.0.7500)
# category: Synthesize.Packages.Springs.Geometry
# Converts a Dynamo mesh to a polysurface. Uses multithreading - optimized for 4 cores.

VARmesh = Input(VARmesh: var[])
python_script = Python(IN[0]=VARmesh)
# ---------- python_script.python (58 lines) ----------
#Copyright(c) 2016, Dimitar Venkov
# @5devene, dimitar.ven@gmail.com
import clr
from System.Threading import Thread, ThreadStart

clr.AddReference('ProtoGeometry')
from Autodesk.DesignScript.Geometry import *

def tolist(obj1):
	if hasattr(obj1,'__iter__'): return obj1
	else: return [obj1]

def output1(l1):
	if len(l1) == 1: return l1[0]
	else: return l1

def chop1(l1, n):
	return [l1[x:x+n] for x in xrange(0, len(l1), n)]

def mesh2ps(topo, f_chop = chop1,
			f_ps1 = PolySurface.ByJoinedSurfaces):
	vp = topo.VertexPositions
	fi = topo.FaceIndices
	xr1 = xrange(len(fi) )
	ind = [(fi[i].A, fi[i].B, fi[i].C) for i in xr1]
	ptslist = [ map(vp.__getitem__, ind[i]) for i in xr1]
	len1 = int(round(len(ptslist) ) ) / 4 + 1
	surf = [None, None, None, None]

	def ps_generator(i, ptslist,
					 chop1=chop1,
					 f_ps1 = PolySurface.ByJoinedSurfaces,
					 f_sf1 = Surface.ByPerimeterPoints):
		sflist = [f_sf1(pts) for pts in ptslist[i] ]
		while len(sflist) > 10 :
			sflist = chop1(sflist,10)
			sflist = [f_ps1(sf1) for sf1 in sflist]
		surf[i] = sflist
		return
	if len(ptslist) > 7 :
		ptslist = f_chop(ptslist, len1)
		def threaded_ps0(): return ps_generator(0, ptslist)
		def threaded_ps1(): return ps_generator(1, ptslist)
		def threaded_ps2(): return ps_generator(2, ptslist)
		def threaded_ps3(): return ps_generator(3, ptslist)
		threads = (Thread(ThreadStart(threaded_ps0) ),
				   Thread(ThreadStart(threaded_ps1) ),
				   Thread(ThreadStart(threaded_ps2) ),
				   Thread(ThreadStart(threaded_ps3) ) )
		for t in threads: t.Start()
		for t in threads: t.Join()
		return f_ps1(surf[0] + surf[1] + surf[2] + surf[3])
	else:
		ps_generator(0, (ptslist, ) )
		return  f_ps1(surf[0])
		
meshes = tolist(IN[0])
OUT = output1(map(mesh2ps,meshes) )
# ----------------------------------------
VARPolySurface = Output(python_script)
