# Dynamo custom node SP.PlanarFace.FixDomain.dyf (Dynamo 2.1.0.7500)
# category: Synthesize.Packages.Springs.Geometry
# Corrects the surface domain of a 3 or 4 point planar face extracted from Revit.

VARsurf = Input(VARsurf: var)
perimeterCurves = Surface.PerimeterCurves(surface=VARsurf)
code_block = CodeBlock(a=perimeterCurves) { a[[0,2]]; }
code_block_2 = CodeBlock(a=perimeterCurves) { a[[1,3]]; }
byLoft = Surface.ByLoft(crossSections=code_block, guideCurves=code_block_2)
VARsurface = Output(byLoft)
