# Dynamo custom node SP.Points.PruneDuplicates+.dyf (Dynamo 2.1.0.7500)
# category: Synthesize.Packages.Springs.Geometry
# An alternative to the built in node, that performs faster at the price of loosing the order of the points. All floating point valies are rounded to the nearest 4 decimal points. You can optionally remove duplicate Z values by setting "keepDuplicateZ" to false.

VARpoints = Input(VARpoints: var[])
VARkeepDuplicateZ = Input(VARkeepDuplicateZ: bool = true)
python_script = Python(IN[0]=VARpoints, IN[1]=VARkeepDuplicateZ)
# ---------- python_script.python (19 lines) ----------
import clr
from itertools import groupby
from operator import itemgetter
clr.AddReference('ProtoGeometry')
from Autodesk.DesignScript.Geometry import Point

def p2t(p) : return round(p.X,4), round(p.Y,4), round(p.Z,4)

pts = map(p2t, IN[0])
unique_pts = set(pts)
if not IN[1]:
	same_z = [(i[:2],i[-1]) for i in unique_pts]
	same_z.sort(key = itemgetter(0) )
	unique_pts = []
	for k, g in groupby(same_z, itemgetter(0) ):
		coord = list(k)
		coord.append(max([i[-1] for i in g]) )
		unique_pts.append(coord)
OUT = [Point.ByCoordinates(*i) for i in unique_pts]
# ----------------------------------------
VARpoints_2 = Output(python_script)  # "VARpoints"
