# Dynamo custom node ST.Element.3DCropViewTopBaseOffset.dyf (Dynamo 2.1.0.7500)
# category: Synthesize.Packages.SteamNodes.Element
# create 3d view for each element and crop view

VARBoundingBoxes = Input(VARBoundingBoxes: var[]..[])
minPoint = BoundingBox.MinPoint(boundingBox=VARBoundingBoxes)
VAROffset = Input(VAROffset: var[]..[])
code_block = CodeBlock(a=VAROffset) { -a; }
VARBaseOffset_Z = Input(VARBaseOffset_Z: var[]..[])
code_block_2 = CodeBlock(a=VARBaseOffset_Z) { -a; }
byCoordinates = Vector.ByCoordinates(x=code_block, y=code_block, z=code_block_2, lacing=Longest)
add = Point.Add(point=minPoint, vectorToAdd=byCoordinates)
maxPoint = BoundingBox.MaxPoint(boundingBox=VARBoundingBoxes)
VARTopOffset_Z = Input(VARTopOffset_Z: var[]..[])
byCoordinates_2 = Vector.ByCoordinates(x=VAROffset, y=VAROffset, z=VARTopOffset_Z, lacing=Longest)
add_2 = Point.Add(point=maxPoint, vectorToAdd=byCoordinates_2)
python_script = Python(IN[0]=add, IN[1]=add_2)
# ---------- python_script.python (59 lines) ----------
#python nodes in dynamo 1.0
#proposed by Julien Benoit @jbenoit44 
#http://aecuandme.wordpress.com/
import clr
clr.AddReference('ProtoGeometry')
from Autodesk.DesignScript.Geometry import *
# Import ToDSType(bool) extension method
clr.AddReference("RevitNodes")
import Revit
clr.ImportExtensions(Revit.Elements)
# Import geometry conversion extension methods
clr.ImportExtensions(Revit.GeometryConversion)
# Import DocumentManager and TransactionManager
clr.AddReference("RevitServices")
import RevitServices
from RevitServices.Persistence import DocumentManager
from RevitServices.Transactions import TransactionManager
from System.Collections.Generic import *
# Import RevitAPI
clr.AddReference("RevitAPI")
import Autodesk
from Autodesk.Revit.DB import *

doc = DocumentManager.Instance.CurrentDBDocument
uiapp = DocumentManager.Instance.CurrentUIApplication
app = uiapp.Application
uidoc=DocumentManager.Instance.CurrentUIApplication.ActiveUIDocument

Min=[]
Max=[]
viewlist=[]
bbox=[]
for i in IN[0]:
	Min.append(UnwrapElement(i.ToXyz(True)))
for i in IN[1]:
	Max.append(UnwrapElement(i.ToXyz(True)))



# Start Transaction
TransactionManager.Instance.EnsureInTransaction(doc)
activeview=doc.ActiveView
typeid=View.GetTypeId(activeview)

count = 0
while (count < len(Min)):
	b=View3D.CreateIsometric(doc,typeid)
	viewlist.append(b)
	box = app.Create.NewBoundingBoxXYZ()
	box.Min = Min[count]
	box.Max = Max[count]
	bbox.append(box)
	a=View3D.SetSectionBox(b,box)
	count = count + 1
	

# End Transaction
TransactionManager.Instance.TransactionTaskDone()
OUT=bbox,viewlist
# ----------------------------------------
code_block_3 = CodeBlock(a=python_script) { a[0]; a[1]; }
VARViews = Output(code_block_3.out1)
VARBbox = Output(code_block_3.out0)
VARRefreshbool = Input(VARRefreshbool: var[]..[])
code_block_4 = CodeBlock(a=VARRefreshbool) { a; }
