# Dynamo custom node ST.Element.GetAllElementsFromLinkedFile.dyf (Dynamo 2.1.0.7500)
# category: Synthesize.Automate.Links
# ST.Element.GetAllElementsFromLinkedFile

VARLinkDocument = Input(VARLinkDocument: var[]..[])
firstItem = List.FirstItem(list=VARLinkDocument)
VARLinkInstance = Input(VARLinkInstance: var[]..[])
python_script = Python(IN[0]=firstItem, IN[1]=VARLinkInstance)
# ---------- python_script.python (42 lines) ----------
#python nodes in dynamo 1.0
#proposed by Julien Benoit @jbenoit44 
#http://aecuandme.wordpress.com/
import System
import clr
clr.AddReference('ProtoGeometry')
from Autodesk.DesignScript.Geometry import *
# Import ToDSType(bool) extension method
clr.AddReference("RevitNodes")
import Revit
clr.ImportExtensions(Revit.Elements)
# Import geometry conversion extension methods
clr.ImportExtensions(Revit.GeometryConversion)
# Import DocumentManager and TransactionManager
clr.AddReference("RevitServices")
import RevitServices
from RevitServices.Persistence import DocumentManager
from RevitServices.Transactions import TransactionManager
from System.Collections.Generic import *
# Import RevitAPI
clr.AddReference("RevitAPI")
import Autodesk
from Autodesk.Revit.DB import *

doc = DocumentManager.Instance.CurrentDBDocument
uiapp = DocumentManager.Instance.CurrentUIApplication
app = uiapp.Application
uidoc=DocumentManager.Instance.CurrentUIApplication.ActiveUIDocument

LinkDoc=IN[0]
LinkInst = IN[1]

elementlist = []
typelist=[]
T = []

collector = FilteredElementCollector(LinkDoc)
collector.OfClass(FamilySymbol)
famtypeitr = collector.GetElementIterator()
fec = FilteredElementCollector(LinkDoc).WhereElementIsNotElementType().ToElements()

OUT = fec
# ----------------------------------------
VARElements = Output(python_script)
