# Dynamo custom node ST.Element.GetParts.dyf (Dynamo 2.1.0.7500)
# category: Synthesize.Packages.SteamNodes.Element
# Get parts for the elements from Input. Returns Parts and Parent elements

VARList = Input(VARList: var[]..[])
code_block = CodeBlock(item=VARList) { DSCore.List.Flatten([item]); }
python_script = Python(IN[0]=code_block)
# ---------- python_script.python (43 lines) ----------
#python nodes in dynamo 1.0
#proposed by Julien Benoit @jbenoit44 
#http://aecuandme.wordpress.com/
import clr
clr.AddReference('ProtoGeometry')
from Autodesk.DesignScript.Geometry import *
# Import ToDSType(bool) extension method
clr.AddReference("RevitNodes")
import Revit
clr.ImportExtensions(Revit.Elements)
# Import geometry conversion extension methods
clr.ImportExtensions(Revit.GeometryConversion)
# Import DocumentManager and TransactionManager
clr.AddReference("RevitServices")
import RevitServices
from RevitServices.Persistence import DocumentManager
from RevitServices.Transactions import TransactionManager
from System.Collections.Generic import *
# Import RevitAPI
clr.AddReference("RevitAPI")
import Autodesk
from Autodesk.Revit.DB import *

doc = DocumentManager.Instance.CurrentDBDocument
uiapp = DocumentManager.Instance.CurrentUIApplication
app = uiapp.Application

elts = []
Ids = []
List=[]
for i in IN[0]:
	elts.append(UnwrapElement(i))

for e in elts:
	Ids.append(e.Id)
	
for i in Ids:
	a=PartUtils.GetAssociatedParts(doc,i,True,True)
	Parts=[]
	for i in a:
		Parts.append(doc.GetElement(i).ToDSType(True))	
	List.append(Parts)
OUT = List
# ----------------------------------------
VARParts = Output(python_script)
isEmpty = List.IsEmpty(list=python_script, lacing=Longest)
filterByBoolMask = List.FilterByBoolMask(list=VARList, mask=isEmpty)
VARParents = Output(filterByBoolMask.out)
