# Dynamo custom node ST.List.FilterByString.dyf (Dynamo 2.1.0.7500)
# category: Synthesize.Packages.SteamNodes.List
# Filter a list by a string match

VARlist = Input(VARlist: var[]..[])
code_block = CodeBlock { false; }
clean = List.Clean(list=VARlist, preserveIndices=code_block)
string_from_object = FromObject(obj=clean)
code_block_2 = CodeBlock { ":"; }
split = String.Split(str=string_from_object, separator0=code_block_2)
firstItem = List.FirstItem(list=split@L2)
toLower = String.ToLower(str=firstItem)
VARString = Input(VARString: var[]..[])
toLower_2 = String.ToLower(str=VARString)
eq = toLower == toLower_2  # lacing=Longest
filterByBoolMask = List.FilterByBoolMask(list=clean, mask=eq)
VARMatch = Output(filterByBoolMask.in)
VAROther = Output(filterByBoolMask.out)
VARBool = Output(eq)
