# Dynamo custom node ST.Tool.CreateAssembly.dyf (Dynamo 2.1.0.7500)
# category: Synthesize.Packages.SteamNodes.Tool
# Create an Assembly for each element

VARList = Input(VARList: var[]..[])
code_block = CodeBlock(a=VARList) { DSCore.List.Flatten([a]); }
python_script = Python(IN[0]=code_block)
# ---------- python_script.python (46 lines) ----------
#python nodes in dynamo 1.0
#proposed by Julien Benoit @jbenoit44 
#http://aecuandme.wordpress.com/
import clr
clr.AddReference('ProtoGeometry')
from Autodesk.DesignScript.Geometry import *
# Import ToDSType(bool) extension method
clr.AddReference("RevitNodes")
import Revit
clr.ImportExtensions(Revit.Elements)
# Import geometry conversion extension methods
clr.ImportExtensions(Revit.GeometryConversion)
# Import DocumentManager and TransactionManager
clr.AddReference("RevitServices")
import RevitServices
from RevitServices.Persistence import DocumentManager
from RevitServices.Transactions import TransactionManager
from System.Collections.Generic import *
# Import RevitAPI
clr.AddReference("RevitAPI")
import Autodesk
from Autodesk.Revit.DB import *

doc = DocumentManager.Instance.CurrentDBDocument
uiapp = DocumentManager.Instance.CurrentUIApplication
app = uiapp.Application
uidoc=DocumentManager.Instance.CurrentUIApplication.ActiveUIDocument

elt = []
for i in IN[0]:
	elt.append(UnwrapElement(i).Id)
	
catid=doc.GetElement(elt[0]).Category.Id
	
collection=List[ElementId](elt)


# Start Transaction
TransactionManager.Instance.EnsureInTransaction(doc)

a=AssemblyInstance.Create(doc,collection,catid)

# End Transaction
TransactionManager.Instance.TransactionTaskDone()

OUT=a
# ----------------------------------------
VARAssemblyInstances = Output(python_script)
