# Dynamo custom node ST.Tool.GetRevitSelection.dyf (Dynamo 2.1.0.7500)
# category: Synthesize.Packages.SteamNodes.Tool
# Get the selection from the Revit UI, use boolean action to refresh when selection must be updated

empty = List.Empty()
VARreset = Input(VARreset: bool = true)
python_script = Python(IN[0]=empty, IN[1]=VARreset)
# ---------- python_script.python (42 lines) ----------
#python nodes in dynamo 1.0
#proposed by Julien Benoit @jbenoit44 
#http://aecuandme.wordpress.com/
import clr
clr.AddReference('ProtoGeometry')
from Autodesk.DesignScript.Geometry import *
# Import ToDSType(bool) extension method
clr.AddReference("RevitNodes")
import Revit
clr.ImportExtensions(Revit.Elements)
# Import geometry conversion extension methods
clr.ImportExtensions(Revit.GeometryConversion)
# Import DocumentManager and TransactionManager
clr.AddReference("RevitServices")
import RevitServices
from RevitServices.Persistence import DocumentManager
from RevitServices.Transactions import TransactionManager
from System.Collections.Generic import *
# Import RevitAPI
clr.AddReference("RevitAPI")
import Autodesk
from Autodesk.Revit.DB import *

doc = DocumentManager.Instance.CurrentDBDocument
uiapp = DocumentManager.Instance.CurrentUIApplication
app = uiapp.Application
uidoc=DocumentManager.Instance.CurrentUIApplication.ActiveUIDocument

sel=[]
elt=[]
# Start Transaction
TransactionManager.Instance.EnsureInTransaction(doc)

sel=uidoc.Selection.GetElementIds()

for i in sel:
	elt.append(doc.GetElement(i).ToDSType(True))
		
# End Transaction
TransactionManager.Instance.TransactionTaskDone()

OUT=elt
# ----------------------------------------
VARElement = Output(python_script)
