# Dynamo custom node ST.Viewport.SetBoxCenter.dyf (Dynamo 2.1.0.7500)
# category: Synthesize.Packages.SteamNodes.View
# API class

VARViewportlist = Input(VARViewportlist: var[]..[])
VARPoints = Input(VARPoints: var[]..[])
python_script = Python(IN[0]=VARViewportlist, IN[1]=VARPoints)
# ---------- python_script.python (46 lines) ----------
#python nodes in dynamo 1.2
#proposed by Julien Benoit @jbenoit44 
#http://aecuandme.wordpress.com/
import clr
clr.AddReference('ProtoGeometry')
from Autodesk.DesignScript.Geometry import *
# Import ToDSType(bool) extension method
clr.AddReference("RevitNodes")
import Revit
clr.ImportExtensions(Revit.Elements)
# Import geometry conversion extension methods
clr.ImportExtensions(Revit.GeometryConversion)
# Import DocumentManager and TransactionManager
clr.AddReference("RevitServices")
import RevitServices
from RevitServices.Persistence import DocumentManager
from RevitServices.Transactions import TransactionManager
from System.Collections.Generic import *
# Import RevitAPI
clr.AddReference("RevitAPI")
import Autodesk
from Autodesk.Revit.DB import *

doc = DocumentManager.Instance.CurrentDBDocument
uiapp = DocumentManager.Instance.CurrentUIApplication
app = uiapp.Application
uidoc=DocumentManager.Instance.CurrentUIApplication.ActiveUIDocument

vport = []
for i in IN[0]:
	vport.append(UnwrapElement(i))
pts=[]
for i in IN[1]:
	pts.append(UnwrapElement(i).ToXyz())

# Start Transaction
TransactionManager.Instance.EnsureInTransaction(doc)

for v,p in zip(vport,pts):
	v.SetBoxCenter(p)
			
doc.Regenerate()
# End Transaction
TransactionManager.Instance.TransactionTaskDone()

OUT=IN[0]
# ----------------------------------------
VAROUT = Output(python_script)
