# Dynamo custom node Scale Up and Down Revit Factor.dyf (Dynamo 2.1.0.7500)
# category: Synthesize.Automate.Geometry
# Scale Up and Down Revit Factor

python_script = Python()  # graph input
# ---------- python_script.python (29 lines) ----------
import clr
# Enable Revit API
clr.AddReference('RevitAPI')
from Autodesk.Revit.DB import *

# Enable DocumentManager and TransactionManager
clr.AddReference('RevitServices')
from RevitServices.Persistence import DocumentManager
from RevitServices.Transactions import TransactionManager

doc = DocumentManager.Instance.CurrentDBDocument

def unitconverter(value,doc,frominternal=True):
	if int(DocumentManager.Instance.CurrentUIApplication.Application.VersionNumber) < 2021:
		if frominternal:
			value = UnitUtils.ConvertFromInternalUnits(value,doc.GetUnits().GetFormatOptions(UnitType.UT_Length).DisplayUnits)
		else:
			value = UnitUtils.ConvertToInternalUnits(value,doc.GetUnits().GetFormatOptions(UnitType.UT_Length).DisplayUnits)
	else:
		if frominternal:
			value = UnitUtils.ConvertFromInternalUnits(value,doc.GetUnits().GetFormatOptions(SpecTypeId.Length).GetUnitTypeId())
		else:
			value = UnitUtils.ConvertToInternalUnits(value,doc.GetUnits().GetFormatOptions(SpecTypeId.Length).GetUnitTypeId())
	return value

scaledown = round(unitconverter(0.3048,doc,False),8)
scaleup = round(unitconverter(3.280839895,doc,True),8)

OUT = scaleup,scaledown
# ----------------------------------------
code_block = CodeBlock(a=python_script) { a[0]; a[1]; }
VARUp = Output(code_block.out0)
VARDown = Output(code_block.out1)
