# Dynamo custom node Section By Surface.dyf (Dynamo 2.1.0.7500)
# category: Synthesize.Automate.Surface
# Section By Surface

VARSurface = Input(VARSurface: var[]..[])
turnIntoList = Custom[CW.TurnIntoList](VARunknownItem=VARSurface)  # Turns an element (or a nested list) into a flat list
coordinateSystemAtParameter = Surface.CoordinateSystemAtParameter(surface=turnIntoList)
ZXPlane = CoordinateSystem.ZXPlane(coordinateSystem=coordinateSystemAtParameter)
VARFlipSection = Input(VARFlipSection: var[]..[])
code_block = CodeBlock { 0; }
code_block_2 = CodeBlock { 180; }
scopeIf = Custom[CW.ScopeIf+](VARtest=VARFlipSection, VARtrue=code_block, VARfalse=code_block_2)  # A (hopefully) more robust implementation of ScopeIf. Tests a single boolean and returns a value accordingly.
rotate = CoordinateSystem.Rotate(coordinateSystem=coordinateSystemAtParameter, plane=ZXPlane, degrees=scopeIf)
XYPlane = CoordinateSystem.XYPlane(coordinateSystem=rotate)
byPlane = CoordinateSystem.ByPlane(plane=XYPlane)
XAxis = CoordinateSystem.XAxis(coordinateSystem=byPlane)
YAxis = CoordinateSystem.YAxis(coordinateSystem=byPlane)
origin = Plane.Origin(plane=XYPlane)
vertices = Topology.Vertices(topology=turnIntoList)
pointGeometry = Vertex.PointGeometry(vertex=vertices)
identity = CoordinateSystem.Identity()
transform = Geometry.Transform(geometry=pointGeometry, fromCoordinateSystem=byPlane, contextCoordinateSystem=identity)
code_block_3 = CodeBlock { 0; }
VARViewDepth = Input(VARViewDepth: var[]..[])
bk_preflight_for_section_view = Custom[BK.Preflight for Section View Creation](VARxAxis=XAxis, VARyAxis=YAxis, VARcsOrigin=origin, VARPointList=transform, VARCropRegionOffset=code_block_3, VARViewDepth=VARViewDepth)
VARCS = Output(bk_preflight_for_section_view.VARCoordinateSystem)
VARMIN = Output(bk_preflight_for_section_view.VARminPoint)
VARMAX = Output(bk_preflight_for_section_view.VARmaxPoint)
