# Dynamo custom node Select All Not Keynoted.dyf (Dynamo 2.1.0.7500)
# category: Synthesize.Automate.Select
# Selet All Not Keynoted

python_all_elements_in_active = Custom[Python All Elements In Active View]()  # Python All Elements In Active View
code_block = CodeBlock { "Family"; }
getParameterValueByName = Element.GetParameterValueByName(element=python_all_elements_in_active, parameterName=code_block)
string = StringInput("")
ne = getParameterValueByName != string
filterByBoolMask = List.FilterByBoolMask(list=python_all_elements_in_active, mask=ne)
filterByBoolMask_2 = List.FilterByBoolMask(list=getParameterValueByName, mask=ne)
code_block_2 = CodeBlock { "Keynote"; }
getParameterValueByName_2 = Element.GetParameterValueByName(element=filterByBoolMask_2.in, parameterName=code_block_2)
code_block_3 = CodeBlock { ""; }
eq = getParameterValueByName_2 == code_block_3
filterByBoolMask_3 = List.FilterByBoolMask(list=filterByBoolMask.in, mask=eq)
VARElements = Output(filterByBoolMask_3.in)
