# Dynamo custom node Select All Not Tagged.dyf (Dynamo 2.1.0.7500)
# category: Synthesize.Automate.Select
# Select All Not Tagged

python_all_elements_in_active = Custom[Python All Elements In Active View]()  # Python All Elements In Active View
element_types = ElementTypes("IndependentTag")
all_elements_of_type = ElementsOfType(element_type=element_types)
taggedElement = Tag.TaggedElement(tag=all_elements_of_type)
contains = List.Contains(list=taggedElement)  # unwired: item
filter = List.Filter(list=python_all_elements_in_active, condition=contains)
VARElements = Output(filter.out)
