# Dynamo custom node Select By Reference Planes Intersects with Family and Type.dyf (Dynamo 2.1.0.7500)
# category: Synthesize.Automate.Select
# Select By Reference Planes Intersects with Family and Type

VARFamilyType = Input(VARFamilyType: var[]..[])
all_elements_of_family_type = ElementsOfFamilyType(Family_Type=VARFamilyType)
VARSelectReferencePlanes = Input(VARSelectReferencePlanes: var[]..[])
code_block = CodeBlock { "ReferencePlane"; }
byClassName = Custom[SP.Filter.ByClassName](VARobject=VARSelectReferencePlanes, VARclassName=code_block)  # Filters a list of objects by the object's class name. Note that Dynamo elements belong to different classes than their Revit counterparts. Use the Object.Class node to check an object's class.
boundingBox = Element.BoundingBox(element=byClassName.VARin)
count = List.Count(list=boundingBox)
ofRepeatedItem = List.OfRepeatedItem(item=all_elements_of_family_type, amount=count)
plane = ReferencePlane.Plane(referencePlane=byClassName.VARin)
VARIntersectFactor1000forMetersMore10000 = Input(VARIntersectFactor1000forMetersMore10000forCentimeters..etc: var[]..[])
byWidthLength = Rectangle.ByWidthLength(plane=plane, width=VARIntersectFactor1000forMetersMore10000, length=VARIntersectFactor1000forMetersMore10000)
byPatch = Surface.ByPatch(closedCurve=byWidthLength)
geometry = Element.Geometry(element=all_elements_of_family_type)
flatten = List.Flatten(list=geometry)
doesIntersect = Geometry.DoesIntersect(geometry=byPatch@L1, other=flatten)
filterByBoolMask = List.FilterByBoolMask(list=ofRepeatedItem, mask=doesIntersect)
flatten_2 = List.Flatten(list=filterByBoolMask.in)
VARElements = Output(flatten_2)
