# Dynamo custom node Select Elements By Spline Intersects.dyf (Dynamo 2.1.0.7500)
# category: Synthesize.Automate.Select
# Select Elements By Spline Intersects

VARSplineCurve = Input(VARSplineCurve: var[]..[])
curve = CurveElement.Curve(curveElement=VARSplineCurve)
code_block = CodeBlock { 0..1..#1000; }
pointAtParameter = Curve.PointAtParameter(curve=curve, param=code_block, lacing=CrossProduct)
splitByPoints = Curve.SplitByPoints(curve=curve, points=pointAtParameter)
endPoint = Curve.EndPoint(curve=splitByPoints)
flatten = List.Flatten(list=endPoint)
VARElements = Input(VARElements: var[]..[])
boundingBox = Geometry.BoundingBox(geometry=VARElements)
toCuboid = BoundingBox.ToCuboid()  # unwired: boundingBox
map = List.Map(list=boundingBox, f_x=toCuboid)
isNull = Object.IsNull(obj=map)
filterByBoolMask = List.FilterByBoolMask(list=VARElements, mask=isNull)
curves = Element.Curves(element=filterByBoolMask.in)
as_polycurve_bycurves = Custom[AS.[&] PolyCurve.ByCurves](VARcurves=curves)  # Create polycurves from an unordered list of curves.
closeWithLine = PolyCurve.CloseWithLine(polyCurve=as_polycurve_bycurves.VARpolyCurve)
byPatch = Surface.ByPatch(closedCurve=closeWithLine)
thicken = Surface.Thicken(surface=byPatch)
flatten_2 = List.Flatten(list=thicken)
boundingBox_2 = Geometry.BoundingBox(geometry=flatten_2)
boundingBox_3 = Element.BoundingBox(element=VARElements)
filterByBoolMask_2 = List.FilterByBoolMask(list=boundingBox_3, mask=isNull)
mergeByBoolMask = Custom[SP.List.MergeByBoolMask](VARIn=boundingBox_2, VAROut=filterByBoolMask_2.out, VARmask=isNull)  # Merge two lists by a boolean mask list. The true count in the mask should be the same as the length of the true list and vice versa for the false list.
contains = BoundingBox.Contains(boundingBox=mergeByBoolMask)  # unwired: point
map_2 = List.Map(list=flatten, f_x=contains)
filterByBoolMask_3 = List.FilterByBoolMask(list=VARElements)  # unwired: mask
map_3 = List.Map(list=map_2, f_x=filterByBoolMask_3.in)
flatten_3 = List.Flatten(list=map_3)
uniqueItems = List.UniqueItems(list=flatten_3)
VARlist = Output(uniqueItems)
