# Dynamo custom node Select Elements in Links by ID.dyf (Dynamo 2.1.0.7500)
# category: Synthesize.Automate.Select
# Select Elements in Links by ID

VARIDs = Input(VARIDs: var[]..[])
VARLinkedDoc = Input(VARLinkedDoc: var[]..[])
python_script = Python(IN[0]=VARIDs, IN[1]=VARLinkedDoc)
# ---------- python_script.python (13 lines) ----------
import clr
clr.AddReference("RevitAPI")
import Autodesk
from Autodesk.Revit.DB import *

id1 = IN[0]
LinkedDoc = UnwrapElement(IN[1])
result = []


#Assign your output to the OUT variable.
result.append(LinkedDoc.GetElement(ElementId(id1)))
OUT = result
# ----------------------------------------
VAROUT = Output(python_script)
