# Dynamo custom node Select Topography From Subregion.dyf (Dynamo 2.1.0.7500)
# category: Synthesize.Automate.Topography
# Select Topography From Subregion

VARTopography = Input(VARTopography: var[]..[])
VARLeaveAsIs = Input(VARLeaveAsIs: bool = false)
python_script = Python(IN[0]=VARTopography, IN[1]=VARLeaveAsIs)
# ---------- python_script.python (51 lines) ----------
# Enable Python support and load DesignScript library
# IMPORTANT : ALL DYNAMO DESIGN SCRIPT NODES ARE AS (dg)
import clr
clr.AddReference('ProtoGeometry')
from Autodesk.DesignScript import Geometry as dg

# EXTENSION Enable ToDSType
clr.AddReference('RevitNodes')
import Revit
clr.ImportExtensions(Revit.Elements)

# Enable Revit Elements
from Revit.Elements import *

# EXTENSION Enable Geometry Conversion Methods
clr.ImportExtensions(Revit.GeometryConversion)

# Enable Revit API
clr.AddReference('RevitAPI')
from Autodesk.Revit.DB import *

# Enable DocumentManager and TransactionManager
clr.AddReference('RevitServices')
from RevitServices.Persistence import DocumentManager
from RevitServices.Transactions import TransactionManager

# Enable ICollection List Translate
clr.AddReference("System")
import System.Collections.Generic
from System.Collections.Generic import List

dataEnteringNode = IN
# Use UnwrapElement(IN[0]) When Translating From Dynamo to Revit
sub = UnwrapElement(IN[0])
leaveasis = IN[1]
# Choose The Current Document
doc = DocumentManager.Instance.CurrentDBDocument
uidoc = DocumentManager.Instance.CurrentUIApplication.ActiveUIDocument
uiapp = DocumentManager.Instance.CurrentUIApplication
app = uiapp.Application

try:
	if sub.IsSiteSubRegion and leaveasis == False:
		result = doc.GetElement(sub.AsSiteSubRegion().HostId)
	else:
		result = sub
except:
	result = sub

# Assign your output to the OUT variable.
OUT = result
# ----------------------------------------
VARTopography_2 = Output(python_script)  # "VARTopography"
