# Dynamo custom node Sequenced String Numbers Generate.dyf (Dynamo 2.1.0.7500)
# category: Synthesize.Automate.Math
# Sequenced String Numbers Generate

VARRemove0s = Input(VARRemove0s: var[]..[])
VARPrefixtoAddCanbeEmpty = Input(VARPrefixtoAddCanbeEmpty: var[]..[])
VARNumberSequenceStart = Input(VARNumberSequenceStart: var[]..[])
VARCountofElements = Input(VARCountofElements: var[]..[])
code_block = CodeBlock { 1; }
sequence = Sequence(start=VARNumberSequenceStart, amount=VARCountofElements, step=code_block, lacing=Longest)
code_block_2 = CodeBlock(level=VARPrefixtoAddCanbeEmpty, number=sequence) { level+number; }
VAR = Input(VAR: var[]..[])
python_script = Python(IN[0]=VAR)
# ---------- python_script.python (16 lines) ----------
import clr
clr.AddReference('ProtoGeometry')
from Autodesk.DesignScript.Geometry import *
#The inputs to this node will be stored as a list in the IN variable.
precision = IN[0]



if precision == 1:
  OUT = 0.1
elif precision == 2:
  OUT = 0.01
elif precision == 3:
  OUT = 0.001
else:
  raise Exception("Invalid precision input!")
# ----------------------------------------
mul = VARNumberSequenceStart * python_script
sequence_2 = Sequence(start=mul, amount=VARCountofElements, step=python_script, lacing=Longest)
string_from_object = FromObject(obj=sequence_2)
number = DoubleInput(2)
substring = String.Substring(str=string_from_object, startIndex=number, length=VAR)
code_block_3 = CodeBlock(level=VARPrefixtoAddCanbeEmpty, number=substring) { level+number; }
scopeIf = Custom[CW.ScopeIf+](VARtest=VARRemove0s, VARtrue=code_block_2, VARfalse=code_block_3)  # A (hopefully) more robust implementation of ScopeIf. Tests a single boolean and returns a value accordingly.
eq = scopeIf@L1 == scopeIf
countTrue = List.CountTrue(list=eq@L2)
code_block_4 = CodeBlock { 1; }
gt = countTrue > code_block_4
anyTrue = Custom[CW.List.AnyTrue](VARseq=gt)  # Returns true if any item in a list of booleans is true.
code_block_5 = CodeBlock { 0; }
withLeadingZeroes = Custom[CW.List.WithLeadingZeroes](VARnum=code_block_5, VARn=VAR)  # Adds leading zeros to a sequence of numbers
scopeIf_2 = Custom[CW.ScopeIf+](VARtest=VARRemove0s, VARtrue=sequence, VARfalse=substring)
code_block_6 = CodeBlock(a=VARNumberSequenceStart) { a*-1; }
code_block_7 = CodeBlock { 1; }
code_block_8 = CodeBlock { 0; }
withLeadingZeroes_2 = Custom[CW.List.WithLeadingZeroes](VARnum=code_block_8, VARn=VAR)
string_from_object_2 = FromObject(obj=withLeadingZeroes_2)
code_block_9 = CodeBlock(a=code_block_7, b=string_from_object_2) { a+b; }
toNumber = String.ToNumber(str=code_block_9)
code_block_10 = CodeBlock(num=toNumber, a=VARCountofElements) { num-a; }
code_block_11 = CodeBlock(a=code_block_6, b=code_block_10) { a+b; }
itemAtIndex = Custom[SP.List.ItemAtIndex+](VARlist=scopeIf_2, VARindex=code_block_11)  # Identical to the built in node but works with negative indices
eq_2 = withLeadingZeroes == itemAtIndex
join = List.Join(list0=anyTrue, list1=eq_2)
anyTrue_2 = Custom[CW.List.AnyTrue](VARseq=join)
code_block_12 = CodeBlock { "Duplicated names found, Please Increase No.of Digits or Activate Remove 0's"; "No Duplicated Names found"; }
scopeIf_3 = Custom[CW.ScopeIf+](VARtest=anyTrue_2, VARtrue=code_block_12.out0, VARfalse=code_block_12.out1)
VARReport = Output(scopeIf_3)
VARNumberofSelectedElements = Output(VARCountofElements)
VARReverseNaming = Input(VARReverseNaming: var[]..[])
code_block_13 = CodeBlock { null; }
scopeIf_4 = Custom[CW.ScopeIf+](VARtest=anyTrue_2, VARtrue=code_block_13, VARfalse=scopeIf)
code_block_14 = CodeBlock { false; }
clean = List.Clean(list=scopeIf_4, preserveIndices=code_block_14)
code_block_15 = CodeBlock { ""; }
VARSuffixtoAddCanbeEmpty = Input(VARSuffixtoAddCanbeEmpty: var[]..[])
join_2 = String.Join(separator=code_block_15, string1=VARSuffixtoAddCanbeEmpty)  # unwired: string0
map = List.Map(list=clean, f_x=join_2)
reverse = List.Reverse(list=map)
scopeIf_5 = Custom[CW.ScopeIf+](VARtest=VARReverseNaming, VARtrue=reverse, VARfalse=map)
VARValues = Output(scopeIf_5)
