# Dynamo custom node Shift Adaptive Components.dyf (Dynamo 2.1.0.7500)
# category: Synthesize.Automate.Adaptive
# Shift Adaptive Components

VARAdaptiveComponents = Input(VARAdaptiveComponents: var[]..[])
filter_adaptive_component = Custom[Filter Adaptive Component FamilyInstances](VARFamilyInstances=VARAdaptiveComponents)  # Filter Adaptive Component FamilyInstances
VARShiftNumber = Input(VARShiftNumber: int = 1)
VARClockWise = Input(VARClockWise: bool = false)
python_script = Python(IN[0]=filter_adaptive_component, IN[1]=VARShiftNumber, IN[2]=VARClockWise)
# ---------- python_script.python (80 lines) ----------
# Enable Python support and load DesignScript library
# IMPORTANT : ALL DYNAMO DESIGN SCRIPT NODES ARE AS (dg)
import clr
clr.AddReference('ProtoGeometry')
from Autodesk.DesignScript import Geometry as dg

# EXTENSION Enable ToDSType
clr.AddReference('RevitNodes')
import Revit

# EXTENSION Enable Geometry Conversion Methods
clr.ImportExtensions(Revit.GeometryConversion)

# Enable Revit API
clr.AddReference('RevitAPI')
from Autodesk.Revit.DB import *

# Enable DocumentManager and TransactionManager
clr.AddReference('RevitServices')
from RevitServices.Persistence import DocumentManager
from RevitServices.Transactions import TransactionManager

def tolist(obj1):
	if hasattr(obj1,'__iter__'): return obj1
	else: return [obj1]

def flatten(x):
    result = []
    for el in x:
        if hasattr(el, "__iter__") and not isinstance(el, basestring):
            result.extend(flatten(el))
        else:
            result.append(el)
    return result

element = UnwrapElement(flatten(tolist(IN[0])))
shiftnum = int(IN[1])
clockwise = IN[2]

# Choose The Current Document
doc = DocumentManager.Instance.CurrentDBDocument
uidoc = DocumentManager.Instance.CurrentUIApplication.ActiveUIDocument
uiapp = DocumentManager.Instance.CurrentUIApplication
app = uiapp.Application

# Create Empty List
result = []

TransactionManager.Instance.EnsureInTransaction(doc)
for each in element:
	try:
		ids = AdaptiveComponentInstanceUtils.GetInstancePlacementPointElementRefIds(each)
		tmp = []
		for e in ids:
			refpt = doc.GetElement(e)
			elemref = refpt.GetPointElementReference()
			if elemref == None:
				coor = refpt.GetCoordinateSystem().ToCoordinateSystem()
				skp = SketchPlane.Create(doc, coor.XYPlane.ToPlane()).GetPlaneReference()
				xcoor = coor.XAxis.ToXyz()
				orcoor = coor.Origin.ToXyz()
				dynpoints = PointOnPlane.NewPointOnPlane(doc,skp,orcoor,xcoor)
				tmp.append(dynpoints)
			else:
				tmp.append(elemref)
		if clockwise:
			tmp = tmp[-shiftnum:] + tmp[:-shiftnum]
		else:
			tmp = tmp[shiftnum:] + tmp[:shiftnum]
		count = 0
		for e in ids:
			refpt = doc.GetElement(e)
			refpt.SetPointElementReference(tmp[count])
			count += 1
		result.append(each)
	except:
		result.append(None)
TransactionManager.Instance.TransactionTaskDone()

OUT = result
# ----------------------------------------
VARAdaptiveComponents_2 = Output(python_script)  # "VARAdaptiveComponents"
