# Dynamo custom node Simple ByElement Id Selection.dyf (Dynamo 2.1.0.7500)
# category: Synthesize.Automate.Select
# Simple ByElement Id Selection

VARId = Input(VARId: var[]..[])
code_block = CodeBlock(elemid=VARId) { Revit.Elements.ElementSelector.ByElementId(elemid); }
VARElements = Output(code_block)
