# Dynamo custom node Slope Analysis.dyf (Dynamo 2.1.0.7500)
# category: Synthesize.Automate.Topography
# Slope Analysis

VARFullTopo = Input(VARFullTopo: var[]..[])
VARTopography = Input(VARTopography: var[]..[])
code_block = CodeBlock { false; }
polySurface = Custom[ZK.Topography.PolySurface](VARTopography=VARTopography, VARFullTopo=VARFullTopo, VARFullTopoRemovePads=code_block, VARJointoPolysurface=code_block)  # Convert topography element to polysurface
create = List.Create(item0=polySurface.VARSubregionsList, item1=polySurface.VARHostTopography)
code_block_2 = CodeBlock { false; }
clean = List.Clean(list=create, preserveIndices=code_block_2)
flatten = List.Flatten(list=clean)
scopeIf = Custom[CW.ScopeIf+](VARtest=VARFullTopo, VARtrue=flatten, VARfalse=VARTopography)  # A (hopefully) more robust implementation of ScopeIf. Tests a single boolean and returns a value accordingly.
VARAllViews = Input(VARAllViews: var[]..[])
views = Custom[CW.Document.Views]()  # Gets all views in the document - except for 3D view templates (as long as this bug is not fixed: https://github.com/DynamoDS/Dynamo/issues/2970)
VARActiveView = Input(VARActiveView: var[]..[])
scopeIf_2 = Custom[CW.ScopeIf+](VARtest=VARAllViews, VARtrue=views, VARfalse=VARActiveView)
code_block_3 = CodeBlock { 90; }
overrideTransparencyInView = Custom[CW.Element.OverrideTransparencyInView](VARelement=scopeIf, VARview=scopeIf_2@L1, VARtransparencyPercentage=code_block_3)  # Overrides the transparency of an element in a given view
VARElement = Output(overrideTransparencyInView)
VARCategory = Input(VARCategory: var[]..[])
material_name_of_the_surfaces = StringInput("Default")
byName = Material.ByName(name=material_name_of_the_surfaces)
VARStartFactor = Input(VARStartFactor: var[]..[])
count = List.Count(list=polySurface.VARPolySurface)
code_block_4 = CodeBlock { 1; }
sequence = Sequence(start=VARStartFactor, amount=count, step=code_block_4, lacing=Longest)
string_from_object = FromObject(obj=sequence)
byGeometry = DirectShape.ByGeometry(geometry=polySurface.VARPolySurface, category=VARCategory, material=byName, name=string_from_object)
code_block_5 = CodeBlock { 0.5; }
pointAtParameter = Surface.PointAtParameter(surface=polySurface.VARPolySurface, u=code_block_5, v=code_block_5)

# group: Thanks to LandForm
code_block_6 = CodeBlock { 255; 0; 153; 255; }
byARGB = Color.ByARGB(a=code_block_6.out0, r=code_block_6.out1, g=code_block_6.out2, b=code_block_6.out3)
code_block_7 = CodeBlock { 255; 0; 153; 0; }
byARGB_2 = Color.ByARGB(a=code_block_7.out0, r=code_block_7.out1, g=code_block_7.out2, b=code_block_7.out3)
code_block_8 = CodeBlock { 255; 255; 255; 0; }
byARGB_3 = Color.ByARGB(a=code_block_8.out0, r=code_block_8.out1, g=code_block_8.out2, b=code_block_8.out3)
code_block_9 = CodeBlock { 255; 255; 153; 0; }
byARGB_4 = Color.ByARGB(a=code_block_9.out0, r=code_block_9.out1, g=code_block_9.out2, b=code_block_9.out3)
code_block_10 = CodeBlock { 255; 255; 51; 0; }
byARGB_5 = Color.ByARGB(a=code_block_10.out0, r=code_block_10.out1, g=code_block_10.out2, b=code_block_10.out3)
create_2 = List.Create(item0=byARGB, item1=byARGB_2, item2=byARGB_3, item3=byARGB_4, item4=byARGB_5)
code_block_11 = CodeBlock { 0; 0.1; 0.2; 0.333; 1; }
create_3 = List.Create(item0=code_block_11.out0, item1=code_block_11.out1, item2=code_block_11.out2, item3=code_block_11.out3, item4=code_block_11.out4)
code_block_12 = CodeBlock { 1; }
normalAtPoint = Surface.NormalAtPoint(surface=polySurface.VARPolySurface, point=pointAtParameter)
ZAxis = Vector.ZAxis()
angleWithVector = Vector.AngleWithVector(vector=normalAtPoint, otherVector=ZAxis)
formula = Formula("tan(x*0.0174533)", x=angleWithVector)
gt = formula > code_block_12
filterByBoolMask = List.FilterByBoolMask(list=formula, mask=gt)
count_2 = List.Count(list=filterByBoolMask.in)
ofRepeatedItem = List.OfRepeatedItem(item=code_block_12, amount=count_2)
mergeByBoolMask = Custom[SP.List.MergeByBoolMask](VARIn=ofRepeatedItem, VAROut=filterByBoolMask.out, VARmask=gt)  # Merge two lists by a boolean mask list. The true count in the mask should be the same as the length of the true list and vice versa for the false list.
color_range = ColorRange(colors=create_2, indices=create_3, value=mergeByBoolMask)

overrideColorInView = Element.OverrideColorInView(element=byGeometry, color=color_range)
passthrough = Custom[CW.Passthrough](VARpassThrough=overrideColorInView, VARwaitFor=byGeometry)  # Forces a sequential order of execution. The node wired into the output of the Passthrough node will be executed *after* the node wired into the waitFor input (e.g. important for some Revit operations). The value of the passThrough input will be passed on to the node wired into the output port of the Passthrough node.
VARGroupName = Input(VARGroupName: var[]..[])
fromElements = Custom[CW.Group.FromElements](VARelements=passthrough, VARgroupName=VARGroupName)  # Creates a group from a list of Revit elements
VARGroup = Output(fromElements.VARgroup)
VARDirectShape = Output(byGeometry)
empty = List.Empty()
scopeIf_3 = Custom[CW.ScopeIf+](VARtest=VARAllViews, VARtrue=overrideColorInView, VARfalse=empty)
copy_element_overrides = Custom[Copy Element Overrides](VARViews=views, VARElements=scopeIf_3)  # Copy Element Overrides
VAROverriddenTopography = Output(scopeIf)
