# Dynamo custom node Smart Borders of Surface Offset.dyf "Surfaces Border Offset" (Dynamo 2.1.0.7500)
# category: Synthesize.Automate.Surface
# Surfaces Border Offset

VAROffset = Input(VAROffset: var[]..[])
abs = Math.Abs(number=VAROffset)
code_block = CodeBlock { 0; }
eq = abs == code_block
VARSurfaces = Input(VARSurfaces: var[]..[])
empty = List.Empty()
flatten = List.Flatten(list=VARSurfaces)
scopeIf = Custom[CW.ScopeIf+](VARtest=eq, VARtrue=empty, VARfalse=flatten)  # A (hopefully) more robust implementation of ScopeIf. Tests a single boolean and returns a value accordingly.
code_block_2 = CodeBlock { 0.3; }
unit_types = UnitTypes("Length")
displayUnitType = Custom[CW.UnitType.DisplayUnitType](VARunitType=unit_types)  # Retrieves the display unit type for a given unit type.
toDisplayUnit = Custom[CW.InternalUnit.ToDisplayUnit](VARval=code_block_2, VARdisplayUnitType=displayUnitType.VARdisplayUnitType)  # Converts a value from Revit's internal unit to a given display unit
code_block_3 = CodeBlock { 1.650; true; }
k_paneling_framing_only = Custom[K-Paneling Framing Only](VARSuraces=scopeIf, VARFrameDepth=toDisplayUnit, VARFrameWidth=abs, VARSafeThickenFactor=code_block_3.out0, VAROnlySubtractedSurfaces=code_block_3.out1)  # Create Frames By Surfaces
scopeIf_2 = Custom[CW.ScopeIf+](VARtest=eq, VARtrue=VARSurfaces, VARfalse=k_paneling_framing_only.VARExtraFrameOnly)
VARExtraFrameOnly = Output(scopeIf_2)
VARKeepFrame = Input(VARKeepFrame: bool = false)
VARFrameSolids = Output(k_paneling_framing_only.VARFrameSolids)
