# Dynamo custom node Smart Family Type Change.dyf (Dynamo 2.1.0.7500)
# category: Synthesize.Automate.Family
# Smart Family Type Change

VARElements = Input(VARElements: var[]..[])
VARTargetFamilyType = Input(VARTargetFamilyType: var[]..[])
VARChangeTypeValuesToo = Input(VARChangeTypeValuesToo: bool = false)
VARFullReplaceAdaptiveOnly = Input(VARFullReplaceAdaptiveOnly: bool = false)
python_script = Python(IN[0]=VARElements, IN[1]=VARTargetFamilyType, IN[2]=VARChangeTypeValuesToo, IN[3]=VARFullReplaceAdaptiveOnly)
# ---------- python_script.python (198 lines) ----------
# Enable Python support and load DesignScript library
# IMPORTANT : ALL DYNAMO DESIGN SCRIPT NODES ARE AS (dg)
import clr
clr.AddReference('ProtoGeometry')
from Autodesk.DesignScript import Geometry as dg

# EXTENSION Enable ToDSType
clr.AddReference('RevitNodes')
import Revit
clr.ImportExtensions(Revit.Elements)

# Enable Revit Elements
from Revit.Elements import *

# EXTENSION Enable Geometry Conversion Methods
clr.ImportExtensions(Revit.GeometryConversion)

# Enable Revit API
clr.AddReference('RevitAPI')
from Autodesk.Revit.DB import *

# Enable DocumentManager and TransactionManager
clr.AddReference('RevitServices')
from RevitServices.Persistence import DocumentManager
from RevitServices.Transactions import TransactionManager

# Enable ICollection List Translate
clr.AddReference("System")
import System.Collections.Generic
from System.Collections.Generic import List

# Simple Warning Swallow Class
class WarnSwallowSimple(IFailuresPreprocessor):
	def PreprocessFailures(self, failuresAccessor):
		failuresAccessor.DeleteAllWarnings()
		return FailureProcessingResult.Continue

def tolist(obj1):
	if hasattr(obj1,'__iter__'): return obj1
	else: return [obj1]

def flatten(x):
    result = []
    for el in x:
        if hasattr(el, "__iter__") and not isinstance(el, basestring):
            result.extend(flatten(el))
        else:
            result.append(el)
    return result

# Get ElementId or Value String
def bestparamvalue(famdoc,famtype,famparam):
	if famdoc == None and famtype == None:
		ParamValueString = famparam.AsElementId()
		if ParamValueString.ToString() == "-1":
			storagetype = str(famparam.StorageType)
			try:
				if storagetype == "Integer":
					ParamValueString = famparam.AsInteger()
				elif storagetype == "Double":
					ParamValueString = famparam.AsDouble()
				elif storagetype == "String":
					ParamValueString = famparam.AsString()
			except:
				ParamValueString = famparam.AsValueString()
		else:
			try:
				ParamValueString = famparam.AsValueString()
			except:
				ParamValueString = None
	else:
		ParamValueString = famtype.AsElementId(famparam)
		if ParamValueString.ToString() == "-1":
			storagetype = str(famparam.StorageType)
			try:
				if storagetype == "Integer":
					ParamValueString = famtype.AsInteger(famparam)
				elif storagetype == "Double":
					ParamValueString = famtype.AsDouble(famparam)
				elif storagetype == "String":
					ParamValueString = famtype.AsString(famparam)
			except:
				ParamValueString = famtype.AsValueString(famparam)
		else:
			try:
				if famdoc != None:
					ParamValueString = famdoc.GetElement(ParamValueString).Name
				else:
					ParamValueString = famtype.AsValueString(famparam)
			except:
				ParamValueString = famtype.AsValueString(famparam)
	return ParamValueString

def elemOP(doc,elem,typetochangeto,typetoo):
	if typetoo:
		famtypeparams = list(elem.Symbol.GetOrderedParameters()) + list(elem.GetOrderedParameters())
	else:
		famtypeparams = list(elem.GetOrderedParameters())
	vals = []
	for famparam in famtypeparams:
		ParamName = famparam.Definition.Name
		ParamValueString = bestparamvalue(None,None,famparam)
		vals.append([ParamName,ParamValueString])
	elem.ChangeTypeId(typetochangeto.Id)
	if typetoo:
		newfamtypeparams = list(typetochangeto.GetOrderedParameters()) + list(elem.GetOrderedParameters())
	else:
		newfamtypeparams = list(elem.GetOrderedParameters())
	for newfamparam in newfamtypeparams:
		nametest = newfamparam.Definition.Name
		for val in vals:
			if nametest == val[0]:
				if bestparamvalue(None,None,newfamparam) != val[1]:
					try:
						newfamparam.Set(val[1])
					except:
						pass
	return elem
	
def elemOPForced(doc,each,familytype,typetoo):
	try:
		ids = AdaptiveComponentInstanceUtils.GetInstancePlacementPointElementRefIds(each)
		if typetoo:
			params = list(each.Symbol.GetOrderedParameters()) + list(each.GetOrderedParameters())
		else:
			params = list(each.GetOrderedParameters())
		paramsdata = []
		for param in params:
			paramsdata.append([param.Definition.Name,bestparamvalue(None,None,param)])
		tmp = []
		for e in ids:
			refpt = doc.GetElement(e)
			elemref = refpt.GetPointElementReference()
			if elemref == None:
				coor = refpt.GetCoordinateSystem().ToCoordinateSystem()
				skp = SketchPlane.Create(doc, coor.XYPlane.ToPlane()).GetPlaneReference()
				xcoor = coor.XAxis.ToXyz()
				orcoor = coor.Origin.ToXyz()
				dynpoints = PointOnPlane.NewPointOnPlane(doc,skp,orcoor,xcoor)
				tmp.append(dynpoints)
			else:
				tmp.append(elemref)
		newadapt = AdaptiveComponentInstanceUtils.CreateAdaptiveComponentInstance(doc,familytype)
		newparams = newadapt.GetOrderedParameters()
		for newparam in newparams:
			for paramdata in paramsdata:
				if paramdata[0].lower() == newparam.Definition.Name.lower():
					if newparam.IsReadOnly == False:
						try:
							newparam.Set(paramdata[1])
						except:
							pass
		newids = AdaptiveComponentInstanceUtils.GetInstancePlacementPointElementRefIds(newadapt)
		count = 0
		for e in newids:
			refpt = doc.GetElement(e)
			refpt.SetPointElementReference(tmp[count])
			count += 1
		result = newadapt
		doc.Delete(each.Id)
	except:
		result = None
	return result
	
# Choose The Current Document
doc = DocumentManager.Instance.CurrentDBDocument
uidoc = DocumentManager.Instance.CurrentUIApplication.ActiveUIDocument
uiapp = DocumentManager.Instance.CurrentUIApplication
app = uiapp.Application

elements = UnwrapElement(tolist(IN[0]))
typetochangeto = UnwrapElement(IN[1])
typetoo = IN[2]
forced = IN[3]

result = []

TransactionManager.Instance.ForceCloseTransaction()
trans1 = Transaction(doc, 'Smart Type Changing')
trans1.Start()
warnhandle = WarnSwallowSimple()
foptions = trans1.GetFailureHandlingOptions()
foptions.SetFailuresPreprocessor(warnhandle)
trans1.SetFailureHandlingOptions(foptions)
for elem in elements:
	try:
		if forced:
			if AdaptiveComponentInstanceUtils.IsAdaptiveComponentInstance(elem):
				result.append(elemOPForced(doc,elem,typetochangeto,typetoo))
			else:
				continue
		else:
			result.append(elemOP(doc,elem,typetochangeto,typetoo))
	except:
		result.append(None)
trans1.Commit()

OUT = result
# ----------------------------------------
VAROutput = Output(python_script)
