# Dynamo custom node Smart Planar Divided Surface.dyf (Dynamo 2.1.0.7500)
# category: Synthesize.Automate.DividedSurface
# Smart Planar Divided Surface

VARRevitFacesReference = Input(VARRevitFacesReference: var[]..[])
flatten = List.Flatten(list=VARRevitFacesReference)
python_script = Python(IN[0]=flatten)
# ---------- python_script.python (65 lines) ----------
# Enable Python support and load DesignScript library
# IMPORTANT : ALL DYNAMO DESIGN SCRIPT NODES ARE AS (dg)
import clr
clr.AddReference('ProtoGeometry')
from Autodesk.DesignScript import Geometry as dg

# EXTENSION Enable ToDSType
clr.AddReference('RevitNodes')
import Revit
clr.ImportExtensions(Revit.Elements)

# Enable Revit Elements
from Revit.Elements import *

# EXTENSION Enable Geometry Conversion Methods
clr.ImportExtensions(Revit.GeometryConversion)

# Enable Revit API
clr.AddReference('RevitAPI')
from Autodesk.Revit.DB import *

# Enable DocumentManager and TransactionManager
clr.AddReference('RevitServices')
from RevitServices.Persistence import DocumentManager
from RevitServices.Transactions import TransactionManager

# Enable ICollection List Translate
clr.AddReference("System")
import System.Collections.Generic
from System.Collections.Generic import List

dataEnteringNode = IN
# Use UnwrapElement(IN[0]) When Translating From Dynamo to Revit
facesref=UnwrapElement(IN[0])

# Choose The Current Document
doc = DocumentManager.Instance.CurrentDBDocument
uidoc = DocumentManager.Instance.CurrentUIApplication.ActiveUIDocument
uiapp = DocumentManager.Instance.CurrentUIApplication
app = uiapp.Application

# Create Empty List
result = []
names = []
# Start a Transaction with Current Document (doc)
TransactionManager.Instance.EnsureInTransaction(doc)
for f in facesref:
	try:
		divsurf = DividedSurface.Create(doc,f)
		try:
			divsurf.get_Parameter(BuiltInParameter.SPACING_LAYOUT_U).Set(0)
			divsurf.get_Parameter(BuiltInParameter.SPACING_LAYOUT_V).Set(0)
		except:
			pass
		result.append(divsurf)
	except:
		divsurf = DividedSurface.GetDividedSurfaceForReference(doc,f)
		result.append(divsurf)

# End the Transaction with Current Document ()
TransactionManager.Instance.TransactionTaskDone()


# Assign your output to the OUT variable.
OUT = result
# ----------------------------------------
VARSurfaces = Input(VARSurfaces: var[]..[])
flatten_2 = List.Flatten(list=VARSurfaces)
code_block = CodeBlock { true; }
understand_quad_faces = Custom[Understand Quad Faces](VARSurfaces=flatten_2, VARUnderstandorNot=code_block)  # Try to Normalize Faces
VARNumberDistanceU = Input(VARNumberDistanceU: double = 5)
VARNumberDistanceV = Input(VARNumberDistanceV: double = 5)
VARUSpacingMethod = Input(VARUSpacingMethod: bool = false)
VARVSpacingMethod = Input(VARVSpacingMethod: bool = false)
VARLinesExtend = Input(VARLinesExtend: double = 1)
VARControlPointsPrecision = Input(VARControlPointsPrecision: double = 0.2)
python_script_2 = Python(IN[0]=understand_quad_faces, IN[1]=VARNumberDistanceU, IN[2]=VARNumberDistanceV, IN[3]=VARUSpacingMethod, IN[4]=VARVSpacingMethod, IN[5]=VARLinesExtend, IN[6]=VARControlPointsPrecision)
# ---------- python_script_2.python (205 lines) ----------
# Enable Python support and load DesignScript library
# IMPORTANT : ALL DYNAMO DESIGN SCRIPT NODES ARE AS (dg)
import clr
clr.AddReference('ProtoGeometry')
from Autodesk.DesignScript import Geometry as dg

# EXTENSION Enable ToDSType
clr.AddReference('RevitNodes')
import Revit
clr.ImportExtensions(Revit.Elements)

# Enable Revit Elements
from Revit.Elements import *

# EXTENSION Enable Geometry Conversion Methods
clr.ImportExtensions(Revit.GeometryConversion)

# Enable Revit API
clr.AddReference('RevitAPI')
from Autodesk.Revit.DB import *

# Enable DocumentManager and TransactionManager
clr.AddReference('RevitServices')
from RevitServices.Persistence import DocumentManager
from RevitServices.Transactions import TransactionManager

# Enable ICollection List Translate
clr.AddReference("System")
import System.Collections.Generic
from System.Collections.Generic import List

dataEnteringNode = IN
# Use UnwrapElement(IN[0]) When Translating From Dynamo to Revit
surfs=UnwrapElement(IN[0])
distanceU=IN[1]
distanceV=IN[2]
panmethodU=IN[3]
panmethodV=IN[4]
extendfix=IN[5]
precision=IN[6]

distanceUlist = []
distanceVlist = []
for s in surfs:
	distanceUlist.append(distanceU)
	distanceVlist.append(distanceV)

# Choose The Current Document
doc = DocumentManager.Instance.CurrentDBDocument
uidoc = DocumentManager.Instance.CurrentUIApplication.ActiveUIDocument
uiapp = DocumentManager.Instance.CurrentUIApplication
app = uiapp.Application

def normalize(length):
	if length != None:
		if length < 4:
			length = 4
		a = range(0,int(length))
		points = []
		amin, amax = min(a), max(a)
		item = []
		for val in a:
			item.append(float(val-amin) / float(amax-amin))
	else:
		item = [None]
	return item

def truemeasure(c,currentsurf):
	try:
		splits = dg.Geometry.Split(c,currentsurf)
	except:
		splits = []
	innercounter = 0
	goodsplits = []
	for s in splits:
		point = dg.Curve.PointAtParameter(s,0.5)
		if dg.Geometry.DoesIntersect(currentsurf,point) and round(s.Length,1) != 0:
			goodsplits.append(splits[innercounter])
		innercounter += 1
	totalmeasure = []
	for spl in goodsplits:
		try:
			totalmeasure.append(spl.Length)
		except:
			pass
		wantedlength = sum(totalmeasure)
	return wantedlength

def exlines(curve,extendfix,precision):
	exlength = curve.Length/precision
	normed  = normalize(exlength)
	tmpin = []
	for norm in normed:
		pin = dg.Curve.PointAtParameter(curve,norm)
		tmpin.append(pin)
	wanted = dg.NurbsCurve.ByPoints(tmpin)
	extended = dg.Curve.ExtendStart(wanted,extendfix)
	extended = dg.Curve.ExtendEnd(extended,extendfix)
	exlength = extended.Length/precision
	normed  = normalize(exlength)
	tmpin = []
	for norm in normed:
		pin = dg.Curve.PointAtParameter(extended,norm)
		tmpin.append(pin)
	wanted = dg.NurbsCurve.ByPoints(tmpin)
	return wanted

def initialgrids(subbedsurfs,distanceU,distanceV,panmethodU,panmethodV,allsurfs):
	nurbs_surfs = []
	for a in allsurfs:
		nurbs_surfs.append(a)
	
	isolineU = []
	isolineV = []
	
	counter = 0
	for n in nurbs_surfs:
		disU = distanceU[counter]
		disV = distanceV[counter]
		counter += 1
		if panmethodU == False and disU != 0:
			ulen = disU + 2
		elif disU != 0:
			wanUlen = truemeasure(dg.Surface.GetIsoline(n,0,0.5),n)
			ulen = round(wanUlen/disU) + 1
		else:
			ulen = None
		isolineU.append(ulen)
		
		if panmethodV == False and disV != 0:
			vlen = disV + 2
		elif disV != 0:
			wanVlen = truemeasure(dg.Surface.GetIsoline(n,1,0.5),n)
			vlen = round(wanVlen/disV) + 1
		else:
			vlen = None
		isolineV.append(vlen)
	
	normsU = []
	for u in isolineU:
		normedu = normalize(u)
		normedu = normedu[1:-1]
		if normedu == []:
			normedu = [[]]
		normsU.append(normedu)
		
	permall = []
	for surf in allsurfs:
		perms = surf.PerimeterCurves()
		permsfix = []
		for perm in perms:
			permsfix.append(perm)
		permall.append(len(permsfix))
		for perm in perms:
			perm.Dispose()
		
	gridsu = []
	counter = 0
	for surf in allsurfs:
		tmp = []
		currentpu = normsU[counter]
		for p in currentpu:
			try:
				if permall[counter] == 1:
					tmp.append(exlines(dg.Surface.GetIsoline(subbedsurfs[counter],1,p),extendfix,precision))
				else:
					if p == 0 or p == 1:
						tmp.append(exlines(dg.Surface.GetIsoline(subbedsurfs[counter],1,p),extendfix,precision))
					else:
						tmp.append(exlines(dg.Surface.GetIsoline(surf,1,p),extendfix,precision))
			except:
				tmp.append(None)
		counter += 1
		gridsu.append(tmp)
	
	normsV = []
	for v in isolineV:
		normedv = normalize(v)
		normedv = normedv[1:-1]
		if normedv == []:
			normedv = [[]]
		normsV.append(normedv)
	
	gridsv = []
	counter = 0
	for surf in allsurfs:
		tmp = []
		currentpv = normsV[counter]
		for p in currentpv:
			try:
				if permall[counter] == 1:
					tmp.append(exlines(dg.Surface.GetIsoline(subbedsurfs[counter],0,p),extendfix,precision))
				else:
					if p == 0 or p == 1:
						tmp.append(exlines(dg.Surface.GetIsoline(subbedsurfs[counter],0,p),extendfix,precision))
					else:
						tmp.append(exlines(dg.Surface.GetIsoline(surf,0,p),extendfix,precision))
			except:
				tmp.append(None)
		counter += 1
		gridsv.append(tmp)
	return gridsu,gridsv

# Assign your output to the OUT variable.
OUT = initialgrids(surfs,distanceUlist,distanceVlist,panmethodU,panmethodV,surfs)
# ----------------------------------------
transpose = List.Transpose(lists=python_script_2)
flatten_3 = List.Flatten(list=transpose@L3)
VARReferencePlaneNamePrefix = Input(VARReferencePlaneNamePrefix: string = "Dynamo Intersecting Plane")
VARFlipReferencePlanesSide = Input(VARFlipReferencePlanesSide: bool = false)
VARReferencePlanesOffset = Input(VARReferencePlanesOffset: double = 15)
reference_plane_perpendicular_on = Custom[Reference Plane Perpendicular On Face](VARReferencePlaneNamePrefix=VARReferencePlaneNamePrefix, VARFlipReferencePlanesSide=VARFlipReferencePlanesSide, VARReferencePlanesOffset=VARReferencePlanesOffset, VARFaces=flatten_2)  # Reference Plane Perpendicular On Face
python_script_3 = Python(IN[0]=flatten_3, IN[1]=reference_plane_perpendicular_on)
# ---------- python_script_3.python (78 lines) ----------
# Enable Python support and load DesignScript library
# IMPORTANT : ALL DYNAMO DESIGN SCRIPT NODES ARE AS (dg)
import clr
clr.AddReference('ProtoGeometry')
from Autodesk.DesignScript import Geometry as dg

# EXTENSION Enable ToDSType
clr.AddReference('RevitNodes')
import Revit
clr.ImportExtensions(Revit.Elements)

# Enable Revit Elements
from Revit.Elements import *

# EXTENSION Enable Geometry Conversion Methods
clr.ImportExtensions(Revit.GeometryConversion)

# Enable Revit API
clr.AddReference('RevitAPI')
from Autodesk.Revit.DB import *

# Enable DocumentManager and TransactionManager
clr.AddReference('RevitServices')
from RevitServices.Persistence import DocumentManager
from RevitServices.Transactions import TransactionManager

# Enable ICollection List Translate
clr.AddReference("System")
import System.Collections.Generic
from System.Collections.Generic import List

dataEnteringNode = IN
# Use UnwrapElement(IN[0]) When Translating From Dynamo to Revit
curves=UnwrapElement(IN[0])
planes=UnwrapElement(IN[1])

# Choose The Current Document
doc = DocumentManager.Instance.CurrentDBDocument
uidoc = DocumentManager.Instance.CurrentUIApplication.ActiveUIDocument
uiapp = DocumentManager.Instance.CurrentUIApplication
app = uiapp.Application

# Create Empty List
result = []

# Start a Transaction with Current Document (doc)
TransactionManager.Instance.EnsureInTransaction(doc)

splanes = []
for p in planes:
	splanes.append(SketchPlane.Create(doc,p.Id))

count = 0
for sketch in splanes:
	curvelist = curves[count]
	wantedplane = planes[count]
	count += 1
	tmp = []
	for c in curvelist:
		try:
			pulled = dg.Curve.PullOntoPlane(c,wantedplane.GetPlane().ToPlane())
			tmp.append(doc.FamilyCreate.NewModelCurve(pulled.ToRevitType(),sketch))
		except:
			tmp.append(None)
	if len(tmp) == 0:
		tmp = [None]
	result.append(tmp)
'''
count = 0
for c in curves:
	
'''
# End the Transaction with Current Document ()
TransactionManager.Instance.TransactionTaskDone()


# Assign your output to the OUT variable.
OUT = result
# ----------------------------------------
addIntersect = Custom[CW.DividedSurface.AddIntersect](VARdividedSurface=python_script@L1, VARelement=python_script_3@L2)  # Adds an intersect to a divided surface
VARdividedSurface = Output(addIntersect)
