# Dynamo custom node Smart Points By Rooms.dyf (Dynamo 2.1.0.7500)
# category: Synthesize.Automate.Point
# Smart Lights By Rooms

VARCurvesDivideTollerance = Input(VARCurvesDivideTollerance: var[]..[])
VARAllRooms = Input(VARAllRooms: var[]..[])
VARYesNoSyncParameter = Input(VARYesNoSyncParameter: var[]..[])
rooms_upper_surfaces = Custom[Rooms Upper Surfaces](VARAllRooms=VARAllRooms, VARYesNoSyncParameter=VARYesNoSyncParameter)  # Rooms Upper Surfaces
VAROffsetFromWalls = Input(VAROffsetFromWalls: var[]..[])
VARUDistance = Input(VARUDistance: var[]..[])
VARVDistance = Input(VARVDistance: var[]..[])
smart_points_by_surfaces = Custom[Smart Points By Surfaces](VARCurvesDivideTollerance=VARCurvesDivideTollerance, VARSurfaces=rooms_upper_surfaces.VARUpperSurfaces, VAROffsetFromWalls=VAROffsetFromWalls, VARUDistance=VARUDistance, VARVDistance=VARVDistance)  # Smart Points By Surfaces
