# Dynamo custom node Smart Prepare Divided Surfaces Geometry.dyf (Dynamo 2.1.0.7500)
# category: Synthesize.Automate.DividedSurface
# Smart Prepare Divided Surfaces Geometry

VARSurfaces = Input(VARSurfaces: var[]..[])
code_block = CodeBlock { 2.10; }
update_dynamo_wait = Custom[Update Dynamo Wait](VARWait=VARSurfaces, VARVersion=code_block)  # Update Dynamo Wait
flatten = List.Flatten(list=update_dynamo_wait)
get_divided_surfaces_of_surfaces = Custom[Get Divided Surfaces of Surfaces](VARSurfaces=flatten)  # Get Divided Surfaces of Surfaces
isNull = Object.IsNull(obj=get_divided_surfaces_of_surfaces)
filterByBoolMask = List.FilterByBoolMask(list=get_divided_surfaces_of_surfaces, mask=isNull)
get_family_instances_of_divided = Custom[Get Family Instances of Divided Surface](VARDividedSurfaces=filterByBoolMask.out)  # Get Family Instances of Divided Surface
isEmpty = List.IsEmpty(list=get_family_instances_of_divided, lacing=Longest)
filterByBoolMask_2 = List.FilterByBoolMask(list=filterByBoolMask.out, mask=isEmpty)
filterByBoolMask_3 = List.FilterByBoolMask(list=flatten, mask=isNull)
filterByBoolMask_4 = List.FilterByBoolMask(list=filterByBoolMask_3.out, mask=isEmpty)
python_script = Python(IN[0]=filterByBoolMask_2.in, IN[1]=filterByBoolMask_4.in)
# ---------- python_script.python (137 lines) ----------
# Enable Python support and load DesignScript library
# IMPORTANT : ALL DYNAMO DESIGN SCRIPT NODES ARE AS (dg)
import clr
clr.AddReference('ProtoGeometry')
from Autodesk.DesignScript import Geometry as dg

# EXTENSION Enable ToDSType
clr.AddReference('RevitNodes')
import Revit
clr.ImportExtensions(Revit.Elements)

# Enable Revit Elements
from Revit.Elements import *

# EXTENSION Enable Geometry Conversion Methods
clr.ImportExtensions(Revit.GeometryConversion)

# Enable Revit API
clr.AddReference('RevitAPI')
from Autodesk.Revit.DB import *

# Enable DocumentManager and TransactionManager
clr.AddReference('RevitServices')
from RevitServices.Persistence import DocumentManager
from RevitServices.Transactions import TransactionManager

# Enable ICollection List Translate
clr.AddReference("System")
import System.Collections.Generic
from System.Collections.Generic import List

dataEnteringNode = IN
# Use UnwrapElement(IN[0]) When Translating From Dynamo to Revit
divs = UnwrapElement(IN[0])
surfs = UnwrapElement(IN[1])

# Choose The Current Document
doc = DocumentManager.Instance.CurrentDBDocument
uidoc = DocumentManager.Instance.CurrentUIApplication.ActiveUIDocument
uiapp = DocumentManager.Instance.CurrentUIApplication
app = uiapp.Application

def doesinter(a,b,tollerance = 0.05):
	try:
		if round(dg.Geometry.DistanceTo(a,b),2) < tollerance:
			return True
		else:
			return False
	except:
		return False

def cleangeom(geom,surf):
	meshfound = False
	for g in geom:
		if g.ToString() == "Autodesk.Revit.DB.Mesh":
			meshfound = True
			break
	fixgeom = []		
	for g in geom:
		stringcompare = g.ToString()
		if meshfound:
			if stringcompare == "Autodesk.Revit.DB.Mesh":
				fixgeom.append(g)
		else:
			if stringcompare != "Autodesk.Revit.DB.Point" and stringcompare != "Autodesk.Revit.DB.Solid":
				fixgeom.append(g)
	result = []
	for e in fixgeom:
		try:
			try:
				conv = e.GeometryCurve
			except:
				conv = e
			if conv.ToString() != "Autodesk.Revit.DB.CylindricalHelix":
				result.append(conv.ToProtoType())
			else:
				tess = conv.Tessellate()
				tmp = []
				for s in tess:
					tmp.append(s.ToPoint())
				result.append(dg.NurbsCurve.ByPoints(tmp))
		except:
			result.append(None)
	slist = result
	newlists = []
	perm = surf.PerimeterCurves()
	count = 0
	for s in slist:
		f = fixgeom[count]
		count += 1
		if s.ToString() == "Mesh":
			newlists.append(f)
			continue
		if s != None:
			breakstatus = False
			for p in perm:
				if doesinter(dg.Curve.PointAtParameter(s,0.3),p) and doesinter(dg.Curve.PointAtParameter(s,0.3),p):
					breakstatus = True
					break
			if breakstatus == False:
				newlists.append(f)
	return newlists

opt1 = Options()

result = []
parmU = []
TransactionManager.Instance.ForceCloseTransaction()
trans = Transaction(doc, 'Fetching Divided Surface')
trans.Start()
count = 0
for div in divs:
	surf = surfs[count]
	count += 1
	if div.USpacingRule.Layout.ToString() != "None" and div.VSpacingRule.Layout.ToString() == "None":
		geom = cleangeom(div.get_Geometry(opt1),surf)
		parmU.append(len(geom))
		result.append(geom)
	elif div.USpacingRule.Layout.ToString() == "None" and div.VSpacingRule.Layout.ToString() != "None":
		geom = cleangeom(div.get_Geometry(opt1),surf)
		parmU.append(0)
		result.append(geom)
	elif div.USpacingRule.Layout.ToString() != "None" and div.VSpacingRule.Layout.ToString() != "None":
		subtran = SubTransaction(doc)
		subtran.Start()
		div.get_Parameter(BuiltInParameter.SPACING_LAYOUT_V).Set(0)
		doc.Regenerate()
		tmpgeom = cleangeom(div.get_Geometry(opt1),surf)
		subtran.RollBack()
		parmU.append(len(tmpgeom))
		geom = cleangeom(div.get_Geometry(opt1),surf)
		result.append(geom)
	else:
		result.append(None)
		parmU.append(0)
trans.RollBack()
OUT = result,parmU
# ----------------------------------------
code_block_2 = CodeBlock(a=python_script) { a[0]; a[1]; }
helix_to_curves = Custom[Helix to Curves](VARHelixElements=code_block_2.out0@L2)  # Helix to Curves
python_script_2 = Python(IN[0]=helix_to_curves, IN[1]=filterByBoolMask_4.in)
# ---------- python_script_2.python (34 lines) ----------
import clr
clr.AddReference('ProtoGeometry')
from Autodesk.DesignScript.Geometry import *
#The inputs to this node will be stored as a list in the IN variables.
dataEnteringNode = IN

class MyList(list):
    def __contains__(self, typ):
        for val in self:
            if isinstance(val, typ):
                return True
        return False
    
lists = UnwrapElement(IN[0])
surfs = IN[1]

lines = []
surflines = []
pat = []
surfpat = []
bool = []
count = 0
for l in lists:
	if Mesh in MyList(l):
		pat.append([i for i in l if i])
		surfpat.append(surfs[count])
		bool.append(True)
	else:
		lines.append([i for i in l if i])
		surflines.append(surfs[count])
		bool.append(False)
	count += 1
#Assign your output to the OUT variable.
OUT = lines,surflines,pat,surfpat,bool
# ----------------------------------------
code_block_3 = CodeBlock(a=python_script_2) { a[0]; a[1]; a[2]; a[3]; a[4]; }
code_block_4 = CodeBlock { 2; }
normalizeDepth = List.NormalizeDepth(list=code_block_3.out2, rank=code_block_4)
code_block_5 = CodeBlock { "Mesh"; }
byClassName = Custom[SP.Filter.ByClassName](VARobject=normalizeDepth@L2, VARclassName=code_block_5)  # Filters a list of objects by the object's class name. Note that Dynamo elements belong to different classes than their Revit counterparts. Use the Object.Class node to check an object's class.
vertexPositions = Mesh.VertexPositions(mesh=byClassName.VARin)
code_block_6 = CodeBlock { 0.01; }
pruneDuplicates = Point.PruneDuplicates(points=vertexPositions@L3, tolerance=code_block_6)
UVParameterAtPoint = Surface.UVParameterAtPoint(surface=code_block_3.out3, point=pruneDuplicates)
lastItem = List.LastItem(list=UVParameterAtPoint@@L2)
addItemToFront = List.AddItemToFront(item=lastItem@@L1, list=UVParameterAtPoint@L2)
subpairs = Custom[SP.List.Subpairs](VARlist=addItemToFront@@L2)  # Pair up each list item with the next one and drop the list item.
firstItem = List.FirstItem(list=subpairs@@L2)
lastItem_2 = List.LastItem(list=subpairs@@L2)
byParameterLineOnSurface = Curve.ByParameterLineOnSurface(baseSurface=code_block_3.out3, startParams=firstItem, endParams=lastItem_2)
startPoint = Curve.StartPoint(curve=byParameterLineOnSurface)
endPoint = Curve.EndPoint(curve=byParameterLineOnSurface)
byStartPointEndPoint = Line.ByStartPointEndPoint(startPoint=startPoint, endPoint=endPoint)
as_polycurve_bycurves = Custom[AS.[&] PolyCurve.ByCurves](VARcurves=byStartPointEndPoint)  # Create polycurves from an unordered list of curves.
curves = PolyCurve.Curves(polyCurve=as_polycurve_bycurves.VARpolyCurve)
startPoint_2 = Curve.StartPoint(curve=curves)
byPoints = Polygon.ByPoints(points=startPoint_2)
flatten_2 = List.Flatten(list=byPoints@L3)
code_block_7 = CodeBlock { true; }
borders_panels = Custom[Borders Panels](VARTargetSurfaces=filterByBoolMask_4.out, VARShowPolygons=code_block_7)  # Map Revit Panels
mergeByBoolMask = Custom[SP.List.MergeByBoolMask](VARIn=flatten_2, VAROut=borders_panels.VARALLPOLYGONS, VARmask=isEmpty)  # Merge two lists by a boolean mask list. The true count in the mask should be the same as the length of the true list and vice versa for the false list.
mergeByBoolMask_2 = Custom[SP.List.MergeByBoolMask](VARIn=filterByBoolMask_4.in, VAROut=borders_panels.VARSurfaces, VARmask=isEmpty)
python_script_3 = Python(IN[0]=mergeByBoolMask, IN[1]=mergeByBoolMask_2)
# ---------- python_script_3.python (55 lines) ----------
import clr
clr.AddReference('ProtoGeometry')
from Autodesk.DesignScript import Geometry as dg

def total_length(lines):
	lengths = []
	for l in lines:
		lengths.append(l.Length)
	return round(sum(lengths),2)

polygonslist = IN[0]
originalsurfs = IN[1]

datalist = []
fuck = []
count = 0
for polygons in polygonslist:
	originalsurf = originalsurfs[count]
	tmp_data = []
	for polygon in polygons:
		try:
			patched = dg.Surface.ByPatch(polygon)
			polylen = total_length(polygon.Curves())
			perm = patched.PerimeterCurves()
			newlen = total_length(perm)
			if newlen != polylen:
				patched = dg.Surface.TrimWithEdgeLoops(patched,[dg.PolyCurve.ByJoinedCurves(polygon.Curves())])
			center = polygon.Center()
			initnormal = dg.Surface.NormalAtPoint(patched,center)
			initendp = dg.Line.ByStartPointDirectionLength(center,initnormal).EndPoint
			healthynormal = dg.Surface.NormalAtPoint(originalsurf,center)
			healthyendp = dg.Line.ByStartPointDirectionLength(center,healthynormal).EndPoint
			reversedinitnormal = initnormal.Reverse()
			inversedinitendp = dg.Line.ByStartPointDirectionLength(center,reversedinitnormal).EndPoint
			pts = []
			if dg.Geometry.DistanceTo(initendp,healthyendp) < dg.Geometry.DistanceTo(inversedinitendp,healthyendp):
				#perm = polygon.Curves()
				#for per in perm:
				#	pts.append(per.StartPoint)
				tmp_data.append(patched)
				#patched.Dispose()
			else:
				flippedsurf = dg.Surface.FlipNormalDirection(patched)
				#perm = flippedsurf.PerimeterCurves()
				#for per in perm:
				#	pts.append(per.StartPoint)
				tmp_data.append(flippedsurf)
				#flippedsurf.Dispose()
				patched.Dispose()
		except:
			pass
	datalist.append(tmp_data)
	count += 1
		
OUT = datalist
# ----------------------------------------
VARSurfaces_2 = Output(python_script_3)  # "VARSurfaces"
VASourceSurfaces = Output(mergeByBoolMask_2)
