# Dynamo custom node Smart RFT Path.dyf (Dynamo 2.1.0.7500)
# category: Synthesize.Automate.List
# Smart RFT Path

VARRFTFile = Input(VARRFTFile: var[]..[])
VARCategory = Input(VARCategory: var[]..[] = Revit.Elements.Category.ByName("OST_GenericModel"))
python_script = Python(IN[0]=VARRFTFile, IN[1]=VARCategory)
# ---------- python_script.python (124 lines) ----------
import clr

clr.AddReference('RevitAPI')
from Autodesk.Revit.DB import *

clr.AddReference('RevitNodes')
import Revit
clr.ImportExtensions(Revit.Elements)

clr.AddReference('RevitServices')
import RevitServices
from RevitServices.Persistence import DocumentManager
from RevitServices.Transactions import TransactionManager
clr.AddReference("System")
import System
import sys
pf_path = System.Environment.GetFolderPath(System.Environment.SpecialFolder.ProgramFilesX86)
sys.path.append('%s\IronPython 2.7\Lib' %pf_path)
from System.Net import WebRequest
import urllib2
import urllib
import os
import clr
# Adding the DynamoRevitDS.dll module to work with the Dynamo API
clr.AddReference('DynamoRevitDS')
import Dynamo 
clr.AddReference('DSCoreNodes')
import DSCore
from DSCore import *
clr.AddReference("RevitServices")
from RevitServices.Persistence import DocumentManager
doc = DocumentManager.Instance.CurrentDBDocument
app = DocumentManager.Instance.CurrentUIApplication.Application
# access to the current Dynamo instance and workspace

originalpath = IN[0]
category = UnwrapElement(IN[1])

try:
	category = Revit.Elements.Category.ByName(category)
except:
	category = category

category = category.Name

script = "\\".join(Dynamo.Applications.DynamoRevit().RevitDynamoModel.CurrentWorkspace.FileName.split("\\")[:-1])

if category == "Ceilings":
	finalfile = script + "\\Sample K-3D Ceilings.rft"
elif category == "Floors":
	finalfile = script + "\\Sample K-3D Floors.rft"
elif category == "Roofs":
	finalfile = script + "\\Sample K-3D Roofs.rft"
elif category == "Stairs":
	finalfile = script + "\\Sample K-3D Stairs.rft"
elif category == "Topography":
	finalfile = script + "\\Sample K-3D Topography.rft"
elif category == "Walls":
	finalfile = script + "\\Sample K-3D Walls.rft"
else:
	if category == "Planting":
		category = "Generic Model"
	elif category == "Adaptive Points":
		category = "Generic Model Adaptive"
	elif category == "Curtain Panels":
		category = "Generic Model Pattern Based"
	elif category[-1] == "s" and category != "Mass":
		category = category[0:-1]
	
	def fast_files(dir):
	    allfiles = [os.path.join(path, name) for path, subdirs, files in os.walk(dir) for name in files]
	    return allfiles
	
	revitversion = app.VersionName.split(" ")[-1]
	wantedfolder = "RVT " + revitversion
	
	doesexist = os.path.isfile(originalpath)
	
	if wantedfolder not in originalpath:
		doesexist = False
	
	if category != "Mass" and "Mass" in originalpath:
		doesexist = False
	
	if doesexist == False:
		if int(DocumentManager.Instance.CurrentUIApplication.Application.VersionNumber) < 2021:
			units = doc.GetUnits().GetFormatOptions(UnitType.UT_Length).DisplayUnits.ToString()
		else:
			units = LabelUtils.GetLabelForUnit(doc.GetUnits().GetFormatOptions(SpecTypeId.Length).GetUnitTypeId())
		fullpath = "C:\\ProgramData\\Autodesk\\"
		allexisted = os.listdir(fullpath)
		
		reallywanted = []
		for a in allexisted:
			if a == wantedfolder:
				if "feet" in units.lower() or "inches" in units.lower():
					if float(revitversion) < 2021:
						reallywanted = fullpath + wantedfolder + "\\Family Templates\\English_I"
					else:
						reallywanted = fullpath + wantedfolder + "\\Family Templates\\English-Imperial"
					prefix = ""
				else:
					reallywanted = fullpath + wantedfolder + "\\Family Templates\\English"
					prefix = "Metric "
				break
		
		try:
			targetcat = prefix + category + ".rft"
			allfiles = fast_files(reallywanted)
			finalfile = []
			for a in allfiles:
				splitted = a.split("\\")[-1]
				if splitted == targetcat:
					finalfile = a
					break
		except:
			pass
		
		if reallywanted == [] or finalfile == []:
			finalfile = originalpath
	else:
		finalfile = originalpath

OUT = finalfile
# ----------------------------------------
VARout = Output(python_script)
