# Dynamo custom node Smart Surface Offset With Reloft.dyf (Dynamo 2.1.0.7500)
# category: Synthesize.Automate.Surface
# Smart Surface Offset With Reloft

VARReloftDistancing = Input(VARReloftDistancing: var[]..[])
VARSurfaces = Input(VARSurfaces: var[]..[])
VARFlipBalancingDirection = Input(VARFlipBalancingDirection: bool = false)
VARPerformReloft = Input(VARPerformReloft: var[]..[])
reloft_faces = Custom[ReLoft Faces](VARDistancing=VARReloftDistancing, VARSurfaces=VARSurfaces, VARFlipBalancingDirection=VARFlipBalancingDirection, VARBalanceOrNot=VARPerformReloft)  # Balance Faces
isNull = Object.IsNull(obj=reloft_faces)
filterByBoolMask = List.FilterByBoolMask(list=reloft_faces, mask=isNull)
VARDistances = Input(VARDistances: var[]..[])
VARJoinAjacentSurfaces = Input(VARJoinAjacentSurfaces: bool = true)
smart_surface_offset = Custom[Smart Surface Offset](VARSurfaces=filterByBoolMask.out, VARDistances=VARDistances, VARJoinAdjacentSurfaces=VARJoinAjacentSurfaces)  # Smart Surface Offset
isNull_2 = Object.IsNull(obj=smart_surface_offset)
filterByBoolMask_2 = List.FilterByBoolMask(list=filterByBoolMask.out, mask=isNull_2)
code_block = CodeBlock { true; }
ne = VARPerformReloft != code_block
reloft_faces_2 = Custom[ReLoft Faces](VARDistancing=VARReloftDistancing, VARSurfaces=filterByBoolMask_2.in, VARFlipBalancingDirection=VARFlipBalancingDirection, VARBalanceOrNot=ne)
isNull_3 = Object.IsNull(obj=reloft_faces_2)
filterByBoolMask_3 = List.FilterByBoolMask(list=reloft_faces_2, mask=isNull_3)
smart_surface_offset_2 = Custom[Smart Surface Offset](VARSurfaces=filterByBoolMask_3.out, VARDistances=VARDistances, VARJoinAdjacentSurfaces=VARJoinAjacentSurfaces)
mergeByBoolMask = Custom[SP.List.MergeByBoolMask](VARIn=filterByBoolMask_3.in, VAROut=smart_surface_offset_2, VARmask=isNull_3)  # Merge two lists by a boolean mask list. The true count in the mask should be the same as the length of the true list and vice versa for the false list.
filterByBoolMask_4 = List.FilterByBoolMask(list=smart_surface_offset, mask=isNull_2)
mergeByBoolMask_2 = Custom[SP.List.MergeByBoolMask](VARIn=mergeByBoolMask, VAROut=filterByBoolMask_4.out, VARmask=isNull_2)
mergeByBoolMask_3 = Custom[SP.List.MergeByBoolMask](VARIn=reloft_faces_2, VAROut=filterByBoolMask_2.out, VARmask=isNull_2)
VARGetUVFromCurtain = Input(VARGetUVFromCurtain: bool = false)
python_script = Python(IN[0]=mergeByBoolMask_2, IN[1]=mergeByBoolMask_3, IN[2]=VARGetUVFromCurtain)
# ---------- python_script.python (26 lines) ----------
# Load the Python Standard and DesignScript Libraries
import sys
import clr
clr.AddReference('ProtoGeometry')
from Autodesk.DesignScript.Geometry import *

# The inputs to this node will be stored as a list in the IN variables.
dataEnteringNode = IN

list1 = UnwrapElement(IN[0])
list2 = UnwrapElement(IN[1])
cond = IN[2]
# Place your code below this line
counter = 0
final1 = []
final2 = []
for l in list1:
	if l != None and cond == False:
		final1.append(l)
		final2.append(list2[counter])
	elif l != None and cond == True and list2[counter] != None:
		final1.append(l)
		final2.append(list2[counter])
	counter += 1
# Assign your output to the OUT variable.
OUT = final1,final2
# ----------------------------------------
code_block_2 = CodeBlock(a=python_script) { a[0]; a[1]; }
VARSurfaces_2 = Output(code_block_2.out0)  # "VARSurfaces"
VAROriginalSurfaces = Output(code_block_2.out1)
isNull_4 = Object.IsNull(obj=smart_surface_offset_2)
countTrue = List.CountTrue(list=isNull_4)
isNull_5 = Object.IsNull(obj=reloft_faces_2)
countTrue_2 = List.CountTrue(list=isNull_5)
add = countTrue + countTrue_2
countTrue_3 = List.CountTrue(list=isNull)
python_script_2 = Python(IN[0]=countTrue_3, IN[1]=VARPerformReloft)
# ---------- python_script_2.python (10 lines) ----------
count = IN[0]
reloft = IN[1]

if reloft == True:
	if count == None or count == 0:
		OUT = None
	else:
		OUT = str(count) + " Surfaces Failed to ReLoft, Try Decreasing the ReLoft Distancing"
else:
	OUT = None
# ----------------------------------------
python_script_3 = Python(IN[0]=add, IN[1]=VARDistances, IN[2]=python_script_2, IN[3]=smart_surface_offset_2)
# ---------- python_script_3.python (17 lines) ----------
count = IN[0]
offset = IN[1]
anothermsg = IN[2]
listcheck = IN[3]

if offset != 0:
	if (count == None or count == 0) and anothermsg == None:
		OUT = None
	else:
		if anothermsg != None and listcheck != None:
			OUT = str(count) + " Surfaces Failed to Offset\n" + anothermsg
		elif listcheck != None:
			OUT = str(count) + " Surfaces Failed to Offset"
elif anothermsg != None:
	OUT = anothermsg
else:
	OUT = None
# ----------------------------------------
VARMessage = Output(python_script_3)
