# Dynamo custom node Smart Surface Offset.dyf (Dynamo 2.1.0.7500)
# category: Synthesize.Automate.Surface
# Smart Surface Offset

VARDistances = Input(VARDistances: var[]..[])
code_block = CodeBlock { 0; }
eq = VARDistances == code_block
VARSurfaces = Input(VARSurfaces: var[]..[])
code_block_2 = CodeBlock { false; }
clean = List.Clean(list=VARSurfaces, preserveIndices=code_block_2)
flatten = List.Flatten(list=clean)
VARJoinAdjacentSurfaces = Input(VARJoinAdjacentSurfaces: bool = true)
empty = List.Empty()
scopeIf = Custom[CW.ScopeIf+](VARtest=VARJoinAdjacentSurfaces, VARtrue=flatten, VARfalse=empty)  # A (hopefully) more robust implementation of ScopeIf. Tests a single boolean and returns a value accordingly.
empty_2 = List.Empty()
scopeIf_2 = Custom[CW.ScopeIf+](VARtest=eq, VARtrue=empty_2, VARfalse=scopeIf)
join_adjacent_surfaces = Custom[Join Adjacent Surfaces](VARSurfaces=scopeIf_2)  # Join Adjacent Surfaces
offset = Surface.Offset(surface=join_adjacent_surfaces, distance=VARDistances)
explode = Geometry.Explode(geometry=offset)
explode_2 = Geometry.Explode(geometry=explode)
code_block_3 = CodeBlock { false; }
clean_2 = List.Clean(list=explode_2, preserveIndices=code_block_3)
flatten_2 = List.Flatten(list=clean_2)
python_script = Python(IN[0]=scopeIf, IN[1]=flatten_2)
# ---------- python_script.python (87 lines) ----------
# Enable Python support and load DesignScript library
# IMPORTANT : ALL DYNAMO DESIGN SCRIPT NODES ARE AS (dg)
import clr
clr.AddReference('ProtoGeometry')
from Autodesk.DesignScript import Geometry as dg

# EXTENSION Enable ToDSType
clr.AddReference('RevitNodes')
import Revit
clr.ImportExtensions(Revit.Elements)

# Enable Revit Elements
from Revit.Elements import *

# EXTENSION Enable Geometry Conversion Methods
clr.ImportExtensions(Revit.GeometryConversion)

# Enable Revit API
clr.AddReference('RevitAPI')
from Autodesk.Revit.DB import *

# Enable DocumentManager and TransactionManager
clr.AddReference('RevitServices')
from RevitServices.Persistence import DocumentManager
from RevitServices.Transactions import TransactionManager

# Enable ICollection List Translate
clr.AddReference("System")
import System.Collections.Generic
from System.Collections.Generic import List

def tolist(obj1):
	if hasattr(obj1,'__iter__'): return obj1
	else: return [obj1]

dataEnteringNode = IN
# Use UnwrapElement(IN[0]) When Translating From Dynamo to Revit
orgsurfs=UnwrapElement(tolist(IN[0]))
newsurfs=UnwrapElement(tolist(IN[1]))

# Choose The Current Document
doc = DocumentManager.Instance.CurrentDBDocument
uidoc = DocumentManager.Instance.CurrentUIApplication.ActiveUIDocument
uiapp = DocumentManager.Instance.CurrentUIApplication
app = uiapp.Application

pts = []
for o in orgsurfs:
	pts.append(dg.Surface.PointAtParameter(o,0.5,0.5))
# Create Empty List
result = []
resultorg = []

for e in newsurfs:
	try:
		ep = dg.Surface.PointAtParameter(e,0.5,0.5)
		distances = []
		for p in pts:
			distances.append(dg.Geometry.DistanceTo(ep,p))
		mindist = min(distances)
		innercounter = 0
		for d in distances:
			correctsurf = orgsurfs[innercounter]
			innercounter += 1
			if d == mindist:
				resultorg.append(correctsurf)
				result.append(e)
				break
	except:
		result.append(None)

sortedorg = []
sorted = []
for s in orgsurfs:
	counter = 0
	for x in resultorg:
		correctsurf = result[counter]
		counter += 1
		if s == x:
			sortedorg.append(x)
			sorted.append(correctsurf)
			break
	if s not in resultorg:
		sortedorg.append(s)
		sorted.append(None)
# Assign your output to the OUT variable.
OUT = sorted
# ----------------------------------------
empty_3 = List.Empty()
scopeIf_3 = Custom[CW.ScopeIf+](VARtest=VARJoinAdjacentSurfaces, VARtrue=empty_3, VARfalse=flatten)
offset_2 = Surface.Offset(surface=scopeIf_3, distance=VARDistances)
scopeIf_4 = Custom[CW.ScopeIf+](VARtest=VARJoinAdjacentSurfaces, VARtrue=python_script, VARfalse=offset_2)
python_empty_2_null = Custom[Python Empty 2 Null](VARIN=scopeIf_4)  # Python Null 2 Empty
scopeIf_5 = Custom[CW.ScopeIf+](VARtest=eq, VARtrue=flatten, VARfalse=python_empty_2_null)
VARSurfaces_2 = Output(scopeIf_5)  # "VARSurfaces"
