# Dynamo custom node Smart Thicken.dyf (Dynamo 2.1.0.7500)
# category: Synthesize.Automate.Surface
# Smart Thicken

VARThickness = Input(VARThickness: double = 1)
code_block = CodeBlock { 0; }
eq = VARThickness == code_block
VARGeometries = Input(VARGeometries: var[]..[])
flatten = List.Flatten(list=VARGeometries)
empty = List.Empty()
scopeIf = Custom[CW.ScopeIf+](VARtest=eq, VARtrue=empty, VARfalse=flatten)  # A (hopefully) more robust implementation of ScopeIf. Tests a single boolean and returns a value accordingly.
code_block_2 = CodeBlock { "Surface"; }
byClassName = Custom[SP.Filter.ByClassName](VARobject=scopeIf, VARclassName=code_block_2)  # Filters a list of objects by the object's class name. Note that Dynamo elements belong to different classes than their Revit counterparts. Use the Object.Class node to check an object's class.
VARBothSides = Input(VARBothSides: bool = true)
thicken = Surface.Thicken(surface=byClassName.VARin, thickness=VARThickness, both_sides=VARBothSides)
mergeByBoolMask = Custom[SP.List.MergeByBoolMask](VARIn=thicken, VAROut=byClassName.VARout, VARmask=byClassName.VARbool)  # Merge two lists by a boolean mask list. The true count in the mask should be the same as the length of the true list and vice versa for the false list.
scopeIf_2 = Custom[CW.ScopeIf+](VARtest=eq, VARtrue=flatten, VARfalse=mergeByBoolMask)
VARGeometries_2 = Output(scopeIf_2)  # "VARGeometries"
