# Dynamo custom node Smooth Curves.dyf (Dynamo 2.1.0.7500)
# category: Synthesize.Automate.Lines
# Smooth Curves

code_block = CodeBlock { 1; 0; }
VARSmoothMode = Input(VARSmoothMode: var[]..[])
VARCurves = Input(VARCurves: var[]..[])
empty = List.Empty()
scopeIf = Custom[CW.ScopeIf+](VARtest=VARSmoothMode, VARtrue=VARCurves, VARfalse=empty)  # A (hopefully) more robust implementation of ScopeIf. Tests a single boolean and returns a value accordingly.
flatten = List.Flatten(list=scopeIf)
as_polycurve_bycurves = Custom[AS.[&] PolyCurve.ByCurves](VARcurves=flatten)  # Create polycurves from an unordered list of curves.
isNull = Object.IsNull(obj=as_polycurve_bycurves.VARpolyCurve)
filterByBoolMask = List.FilterByBoolMask(list=as_polycurve_bycurves.VARpolyCurve, mask=isNull)
isClosed = Curve.IsClosed(curve=filterByBoolMask.out)
filterByBoolMask_2 = List.FilterByBoolMask(list=filterByBoolMask.out, mask=isClosed)
length = Curve.Length(curve=filterByBoolMask_2.in)
VARPointsDistance = Input(VARPointsDistance: var[]..[])
div = length / VARPointsDistance
sequence = Sequence(amount=div, lacing=Longest)
python_script = Python(IN[0]=sequence)
# ---------- python_script.python (18 lines) ----------
import clr
clr.AddReference('ProtoGeometry')
from Autodesk.DesignScript.Geometry import *
#The inputs to this node will be stored as a list in the IN variables.
dataEnteringNode = IN

inside = IN[0]

result = []
for each in inside:
	if len(each) < 5:	
		each = [0,1,2,3,4]
		result.append(each)
	else:
		result.append(each)

#Assign your output to the OUT variable.
OUT = result
# ----------------------------------------
code_block_2 = CodeBlock { 1; 0; }
remapRange = Math.RemapRange(numbers=python_script, newMin=code_block_2.out1, newMax=code_block_2.out0)
dropLastItem = Custom[CW.List.DropLastItem](VARlist=remapRange@L2)  # Drops the last item from a given list.
pointAtParameter = Curve.PointAtParameter(curve=filterByBoolMask_2.in, param=dropLastItem)
code_block_3 = CodeBlock { true; }
byControlPoints = NurbsCurve.ByControlPoints(points=pointAtParameter, closeCurve=code_block_3)
length_2 = Curve.Length(curve=filterByBoolMask_2.out)
div_2 = length_2 / VARPointsDistance
sequence_2 = Sequence(amount=div_2, lacing=Longest)
python_script_2 = Python(IN[0]=sequence_2)
# ---------- python_script_2.python (18 lines) ----------
import clr
clr.AddReference('ProtoGeometry')
from Autodesk.DesignScript.Geometry import *
#The inputs to this node will be stored as a list in the IN variables.
dataEnteringNode = IN

inside = IN[0]

result = []
for each in inside:
	if len(each) < 4:	
		each = [0,1,2,3]
		result.append(each)
	else:
		result.append(each)

#Assign your output to the OUT variable.
OUT = result
# ----------------------------------------
remapRange_2 = Math.RemapRange(numbers=python_script_2, newMin=code_block_2.out1, newMax=code_block_2.out0)
pointAtParameter_2 = Curve.PointAtParameter(curve=filterByBoolMask_2.out, param=remapRange_2)
VARForceClose = Input(VARForceClose: bool)
byControlPoints_2 = NurbsCurve.ByControlPoints(points=pointAtParameter_2, closeCurve=VARForceClose)
create = List.Create(item0=byControlPoints, item1=byControlPoints_2)
code_block_4 = CodeBlock { false; }
clean = List.Clean(list=create, preserveIndices=code_block_4)
flatten_2 = List.Flatten(list=clean)
scopeIf_2 = Custom[CW.ScopeIf+](VARtest=VARSmoothMode, VARtrue=flatten_2, VARfalse=VARCurves)
VARCurves_2 = Output(scopeIf_2)  # "VARCurves"
