# Dynamo custom node Solid By Face Reference Slicer.dyf (Dynamo 2.13.1.3887)
# category: Synthesize.Automate.Solid
# Solid By Face Reference Slicer
# packages: Synthesize toolkit 12.5.1

VARGeometry = Input(VARGeometry: var[]..[])
flatten = List.Flatten(list=VARGeometry)
join = List.Join()  # unwired: list0, list1
VARSurfaces = Input(VARSurfaces: var[]..[])
turnIntoList = Custom[CW.TurnIntoList](VARunknownItem=VARSurfaces)  # package Synthesize toolkit; Turns an element (or a nested list) into a flat list
code_block = CodeBlock { true; }
understand_quad_faces = Custom[Understand Quad Faces](VARSurfaces=turnIntoList, VARUnderstandorNot=code_block)  # package Synthesize toolkit; Try to Normalize Faces
code_block_2 = CodeBlock { false; 0; }
VARReloftDistancing = Input(VARReloftDistancing: var[]..[])
VARReloft = Input(VARReloft: var[]..[])
smart_surface_offset_with_reloft = Custom[Smart Surface Offset With Reloft](VARSurfaces=understand_quad_faces, VARDistances=code_block_2.out1, VARReloftDistancing=VARReloftDistancing, VARJoinAjacentSurfaces=code_block_2.out0, VARPerformReloft=VARReloft, VARGetUVFromCurtain=code_block_2.out0)  # package Synthesize toolkit; Smart Surface Offset With Reloft
VARDirectionUFalseVTrue = Input(VARDirectionUFalseVTrue: var[]..[])
code_block_3 = CodeBlock { 0; 1; }
scopeIf = Custom[CW.ScopeIf+](VARtest=VARDirectionUFalseVTrue, VARtrue=code_block_3.out1, VARfalse=code_block_3.out0)  # package Synthesize toolkit; A (hopefully) more robust implementation of ScopeIf. Tests a single boolean and returns a value accordingly.
VARFalseByNumberTrueByDistance = Input(VARFalseByNumberTrueByDistance: var[]..[])
code_block_4 = CodeBlock { 0; 1; 0.5; }
scopeIf_2 = Custom[CW.ScopeIf+](VARtest=VARDirectionUFalseVTrue, VARtrue=code_block_4.out0, VARfalse=code_block_4.out1)
byIsoCurveOnSurface = Curve.ByIsoCurveOnSurface(baseSurface=smart_surface_offset_with_reloft.VARSurfaces, direction=scopeIf_2, parameter=code_block_4.out2)
length = Curve.Length(curve=byIsoCurveOnSurface)
VARNumberDistance = Input(VARNumberDistance: var[]..[])
div = length / VARNumberDistance
round = Math.Round(number=div)
scopeIf_3 = Custom[CW.ScopeIf+](VARtest=VARFalseByNumberTrueByDistance, VARtrue=round, VARfalse=VARNumberDistance)
sequence = Sequence(amount=scopeIf_3, lacing=Longest)
remapRange = Math.RemapRange(numbers=sequence)
byIsoCurveOnSurface_2 = Curve.ByIsoCurveOnSurface(baseSurface=smart_surface_offset_with_reloft.VARSurfaces@L1, direction=scopeIf, parameter=remapRange)
code_block_5 = CodeBlock { 10; }
sequence_2 = Sequence(amount=code_block_5, lacing=Longest)
remapRange_2 = Math.RemapRange(numbers=sequence_2)
pointAtParameter = Curve.PointAtParameter(curve=byIsoCurveOnSurface_2@@L1, param=remapRange_2)
UVParameterAtPoint = Surface.UVParameterAtPoint(surface=smart_surface_offset_with_reloft.VARSurfaces, point=pointAtParameter)
U = UV.U(uV=UVParameterAtPoint)
V = UV.V(uV=UVParameterAtPoint)
normalAtParameter = Surface.NormalAtParameter(surface=smart_surface_offset_with_reloft.VARSurfaces, u=U, v=V)
code_block_6 = CodeBlock { 0.1; -0.1; }
translate = Geometry.Translate(geometry=pointAtParameter, direction=normalAtParameter, distance=code_block_6.out0)
flatten_2 = List.Flatten(list=translate@L2)
translate_2 = Geometry.Translate(geometry=pointAtParameter, direction=normalAtParameter, distance=code_block_6.out1)
flatten_3 = List.Flatten(list=translate_2@L2)
combine = List.Combine(comb=join, list1=flatten_2, list2=flatten_3)
byBestFitThroughPoints = Plane.ByBestFitThroughPoints(points=combine)
intersect = Geometry.Intersect(geometry=flatten@L1, other=byBestFitThroughPoints)
flatten_4 = List.Flatten(list=intersect@L3)
code_block_7 = CodeBlock { "Autodesk.DesignScript.Geometry.Surface"; }
removeIfNot = List.RemoveIfNot(list=flatten_4@L2, type=code_block_7)
surface_laundry = Custom[Surface Laundry](VARSurfaceOrPolyCurvesList=removeIfNot@L2)  # package Synthesize toolkit; Surface Laundry
VARthickness = Input(VARthickness: var[]..[])
VARthickenbothsides = Input(VARthickenbothsides: var[]..[])
thicken = Surface.Thicken(surface=surface_laundry, thickness=VARthickness, both_sides=VARthickenbothsides)
VARUnionPieces = Input(VARUnionPieces: var[]..[])
try_union = Custom[Try Union](VARGeometryList=thicken@L2, VARUnionOrNot=VARUnionPieces)  # package Synthesize toolkit; Try Union
VARSolids = Output(try_union)
