# Dynamo custom node Sort Geometry By Guides.dyf (Dynamo 2.1.0.7500)
# category: Synthesize.Automate.Loft
# Sort Loft Profiles According to Guide

VARGeometries = Input(VARGeometries: var[]..[])
flatten = List.Flatten(list=VARGeometries)
VARGuides = Input(VARGuides: var[]..[])
flatten_2 = List.Flatten(list=VARGuides)
distanceTo = Geometry.DistanceTo(geometry=flatten_2@L1, other=flatten@L2, lacing=Longest)
transpose = List.Transpose(lists=distanceTo)
minimumItem = List.MinimumItem(list=transpose)
eq = transpose == minimumItem
transpose_2 = List.Transpose(lists=eq)
countTrue = List.CountTrue(list=transpose_2@L2)
maximumItem = List.MaximumItem(list=countTrue)
eq_2 = countTrue == maximumItem
code_block = CodeBlock { false; }
matchLength = Custom[LF.List.MatchLength](VARlistLength=eq_2, VARlist=code_block)  # Cycle a list to match the length of the first list.
code_block_2 = CodeBlock { true; }
hot_index_of_item = Custom[HOT.Index of item](VARList=eq_2, VARItem=code_block_2)  # Index of Item on List
firstItem = List.FirstItem(list=hot_index_of_item)
replaceItemAtIndex = List.ReplaceItemAtIndex(list=matchLength, index=firstItem, item=code_block_2)
filterByBoolMask = List.FilterByBoolMask(list=flatten_2, mask=replaceItemAtIndex)
closestPointTo = Geometry.ClosestPointTo(geometry=flatten_2@L1, other=flatten@L2, lacing=Longest)
filterByBoolMask_2 = List.FilterByBoolMask(list=closestPointTo, mask=replaceItemAtIndex)
flatten_3 = List.Flatten(list=filterByBoolMask_2.in)
parameterAtPoint = Curve.ParameterAtPoint(curve=filterByBoolMask.in, point=flatten_3, lacing=Longest)
as_list_sortbykey = Custom[AS.[&] List.SortByKey](VARlist=flatten, VARkeys=parameterAtPoint)  # Sort a list (or lists) according to the order specified by the key list.
VARSortedGeometries = Output(as_list_sortbykey.VARsortedlist)
VARKeys = Output(parameterAtPoint)
