# Dynamo custom node Street Lines Prepare.dyf (Dynamo 2.1.0.7500)
# category: Synthesize.Automate.Topography
# Street Lines Prepare

VARCADImport = Input(VARCADImport: var[]..[])
turnIntoList = Custom[CW.TurnIntoList](VARunknownItem=VARCADImport)  # Turns an element (or a nested list) into a flat list
VARStreetWidth = Input(VARStreetWidth: var[]..[])
python_script = Python(IN[0]=turnIntoList, IN[1]=VARStreetWidth)
# ---------- python_script.python (1337 lines) ----------
# Created By Karam Baki : karam@aecedx.com
# Enable Python support and load DesignScript library
# IMPORTANT : ALL DYNAMO DESIGN SCRIPT NODES ARE AS (dg)
import clr
clr.AddReference('ProtoGeometry')
from Autodesk.DesignScript import Geometry as dg

# EXTENSION Enable ToDSType
clr.AddReference('RevitNodes')
import Revit
clr.ImportExtensions(Revit.Elements)

# Enable Revit Elements
from Revit.Elements import *

# EXTENSION Enable Geometry Conversion Methods
clr.ImportExtensions(Revit.GeometryConversion)

# Enable Revit API
clr.AddReference('RevitAPI')
from Autodesk.Revit.DB import *
from Autodesk.Revit.DB.Architecture import *
# Enable DocumentManager and TransactionManager
clr.AddReference('RevitServices')
from RevitServices.Persistence import DocumentManager
from RevitServices.Transactions import TransactionManager

# Enable ICollection List Translate
clr.AddReference("System")
import System.Collections.Generic
from System.Collections.Generic import List
import math
from itertools import compress
# Use UnwrapElement(IN[0]) When Translating From Dynamo to Revit
#cadfile=UnwrapElement(IN[0])

# Choose The Current Document
doc = DocumentManager.Instance.CurrentDBDocument
uidoc = DocumentManager.Instance.CurrentUIApplication.ActiveUIDocument
uiapp = DocumentManager.Instance.CurrentUIApplication
app = uiapp.Application

import System
pf_path = System.Environment.GetFolderPath(System.Environment.SpecialFolder.ProgramFilesX86)
import sys
sys.path.append('%s\IronPython 2.7\Lib' %pf_path)
import traceback
import random
import string
import re
temp_path = System.IO.Path.GetTempPath()
def smartFreeForm(geoms,scaleup,doc,centermode=False,category="Generic Models",importinstance=False,singlefinalprocess=False,safemode=False,temp_path=System.IO.Path.GetTempPath(),bypasscheck=False,returnfailures=False):
	class WarnSwallowImport(IFailuresPreprocessor):
		def PreprocessFailures(self, failuresAccessor):
			failuresAccessor.DeleteAllWarnings()
			return FailureProcessingResult.Continue
	def finalimport(importinstance,geoms,satopt,singlefinalprocess):
		randomname = ''.join([random.choice(string.ascii_letters + string.digits) for n in xrange(5)])
		sat_path = '%s%s.sat' % (temp_path, randomname)
		dg.Geometry.ExportToSAT(geoms,sat_path)
		if importinstance:
			imported = doc.Import(sat_path,satopt,None)
			element = doc.GetElement(imported)
			element.Pinned = False
			result = [element]
		else:
			result = []
			shapeImporter = ShapeImporter()
			converted = list(shapeImporter.Convert(doc, sat_path))
			if doc.IsFamilyDocument:
				for e in converted:
					try:
						result.append(FreeFormElement.Create(doc,e))
					except:
						pass
			else:
				form = DirectShape.CreateElement(doc,doc.Settings.Categories.get_Item(category).Id)
				try:
					form.SetShape(converted)
				except:
					doc.Delete(form.Id)
					imported = doc.Import(sat_path,satopt,None)
					element = doc.GetElement(imported)
					element.Pinned = False
					form = element
				result.append(form)
			shapeImporter.Dispose()
		System.IO.File.Delete(sat_path)
		return result
	def allisone(testlist):
		for t in testlist:
			if t != 1:
				return False
		return True
	def tolist(obj1):
		if hasattr(obj1,'__iter__'): return obj1
		else: return [obj1]
	def flatten(x):
		result = []
		for el in x:
			if hasattr(el, "__iter__") and not isinstance(el, basestring):
				result.extend(flatten(el))
			else:
				result.append(el)
		return result
	def movecenter(doc,elements):
		try:
			elements = flatten(elements)
			pts = []
			for e in elements:
				try:
					bbox = e.get_BoundingBox(None)
					pts.append(bbox.Max.ToPoint())
					pts.append(bbox.Min.ToPoint())
				except:
					pass
			Xs = []
			Ys = []
			Zs = []
			for pt in pts:
				Xs.append(pt.X)
				Ys.append(pt.Y)
				Zs.append(pt.Z)
			bigbox = dg.BoundingBox.ByCorners(dg.Point.ByCoordinates(max(Xs),max(Ys),max(Zs)),dg.Point.ByCoordinates(min(Xs),min(Ys),min(Zs)))
			minp = bigbox.MinPoint
			maxp = bigbox.MaxPoint
			midpoint = dg.Curve.PointAtParameter(dg.Line.ByStartPointEndPoint(minp,dg.Point.ByCoordinates(maxp.X,maxp.Y,minp.Z)),0.5)
			mainvec = dg.Vector.ByTwoPoints(midpoint, dg.Point.Origin())
			scaledvec = mainvec.Scale(unitconverter(1,doc,False))
			for e in elements:
				ElementTransformUtils.MoveElement(doc,e.Id,scaledvec.ToXyz())
			return mainvec
		except:
			return None
	def unitconverter(value,doc,frominternal=True):
		if int(DocumentManager.Instance.CurrentUIApplication.Application.VersionNumber) < 2021:
			if frominternal:
				value = UnitUtils.ConvertFromInternalUnits(value,doc.GetUnits().GetFormatOptions(UnitType.UT_Length).DisplayUnits)
			else:
				value = UnitUtils.ConvertToInternalUnits(value,doc.GetUnits().GetFormatOptions(UnitType.UT_Length).DisplayUnits)
		else:
			if frominternal:
				value = UnitUtils.ConvertFromInternalUnits(value,doc.GetUnits().GetFormatOptions(SpecTypeId.Length).GetUnitTypeId())
			else:
				value = UnitUtils.ConvertToInternalUnits(value,doc.GetUnits().GetFormatOptions(SpecTypeId.Length).GetUnitTypeId())
		return value
	def smartrevitsolid(surfs,doc,importinstance,safemode,geometrymode,disposeinit,temp_path):
		def polysurfaceOP(surfaces,chunks=12):
			def smartpolysurface(surfaces,times,round=0):
				if len(surfaces) > chunks:
					if times == 0:
						return surfaces
					result = []
					chopped = [surfaces[x:x+chunks] for x in xrange(0, len(surfaces), chunks)]
					for chop in chopped:
						try:
							joined = dg.PolySurface.ByJoinedSurfaces(chop)
							#if round != 0:
							#	for c in chop:
							#		c.Dispose()
							result.append(joined)
						except:
							for c in chop:
								result.append(c)
					times -= 1
					round += 1
					result = smartpolysurface(result,times,round)
					return result
				else:
					if isinstance(surfaces, dg.PolySurface):
						return surfaces
					else:
						return dg.PolySurface.ByJoinedSurfaces(surfaces)
			surfaces = flatten(tolist(surfaces))
			n = len(surfaces)
			times = 0
			while n > 1:
				n //= chunks
				times += 1
			times *= 1.5
			times = int(round(times))
			joined = smartpolysurface(surfaces,times)
			if isinstance(joined, list):
				try:
					joined = dg.PolySurface.ByJoinedSurfaces(joined)
				except:
					joined = joined
			return joined
		def isActuallygood(geomorsat,converted,firstTime,geometrymode,bypasscheck):
			if firstTime:
				if bypasscheck == False:
					originalfaces = []
					if isinstance(geomorsat,dg.Solid) or isinstance(geomorsat,dg.PolySurface):
						exploded = dg.Geometry.Explode(geomorsat)
						for exp in exploded:
							originalfaces.append(exp)
							if exp.Closed:
								originalfaces.append(exp)
					elif isinstance(geomorsat,dg.Surface):
						if geometrymode == False:
							originalfaces.append(geomorsat)
							if geomorsat.Closed:
								originalfaces.append(geomorsat)
						else:
							exploded = dg.Geometry.Explode(geomorsat)
							for exp in exploded:
								originalfaces.append(exp)
								if exp.Closed:
									originalfaces.append(exp)
					elif isinstance(geomorsat,str):
						geomsorsat = dg.Geometry.ImportFromSAT(geomorsat)
						for geomorsat in geomsorsat:
							if isinstance(geomorsat,dg.Solid) or isinstance(geomorsat,dg.PolySurface):
								exploded = dg.Geometry.Explode(geomorsat)
								for exp in exploded:
									originalfaces.append(exp)
									if exp.Closed:
										originalfaces.append(exp)
								if geometrymode == False and doc.IsFamilyDocument:
									geomorsat.Dispose()
							elif isinstance(geomorsat,dg.Surface):
								if geometrymode == False:
									originalfaces.append(geomorsat)
									if geomorsat.Closed:
										originalfaces.append(geomorsat)
								else:
									exploded = dg.Geometry.Explode(geomorsat)
									for exp in exploded:
										originalfaces.append(exp)
										if exp.Closed:
											originalfaces.append(exp)
						if geometrymode:
							geomorsat = list(geomsorsat)
					originalnum = len(originalfaces)
					for org in originalfaces:
						org.Dispose()
					FFfaces = []
					for e in converted:
						getfaces = e.Faces
						for gotten in getfaces:
							FFfaces.append(gotten)
					FFfacesnum = len(FFfaces)
					if FFfacesnum >= originalnum:
						samefaces = True
					else:
						samefaces = False
				else:
					samefaces = True
				freeforms = []
				if doc.IsFamilyDocument == False and singlefinalprocess and geometrymode == False and samefaces and importinstance == False:
					form = DirectShape.CreateElement(doc,doc.Settings.Categories.get_Item(category).Id)
					try:
						form.SetShape(converted)
						freeforms.append(form)
					except:
						doc.Delete(form.Id)
						satopt = SATImportOptions()
						freeforms.append(finalimport(True,geomsorsat,satopt,True)[0])
						satopt.Dispose()
				if geometrymode == False and samefaces and importinstance == False:
					for e in converted:
						if doc.IsFamilyDocument:
							form = FreeFormElement.Create(doc,e)
							freeforms.append(form)
						elif singlefinalprocess == False:
							form = DirectShape.CreateElement(doc,doc.Settings.Categories.get_Item(category).Id)
							try:
								form.SetShape([e])
								freeforms.append(form)
							except:
								doc.Delete(form.Id)
			else:
				samefaces = False
			if geometrymode:
				if isinstance(geomorsat, list):
					freeforms = geomorsat
				else:
					freeforms = [geomorsat]
			if len(freeforms) == 0:
				return [False]
			if firstTime == False:
				return freeforms
			elif samefaces and firstTime:
				return freeforms
			else:
				return [False]
		def isbellowarea(surface):
			if round(meternumber(surface.Area),2) < meternumber(0.0025):
				return True
			else:
				return False
		def isbellowlength(surface):
			edges = surface.Edges
			for e in edges:
				curvegeom = e.CurveGeometry
				length = curvegeom.Length
				curvegeom.Dispose()
				if length <= 0.0007803686370625:
					return True
			return False
		def meternumber(value):
			value = value
			return value
		def metersurfarea(surface):
			area = meternumber(surface.Area)
			return area
		def almostsame(surf1,surf2,tollerance = 2):
			if round(metersurfarea(surf1),tollerance) == round(metersurfarea(surf2),tollerance):
				return True
			else:
				return False
		def quickSATcheck(sat_path,customscale=[1,1,1],importinstance=False,firstTime=True,geometrymode=False,bypasscheck=False):
			if allisone(customscale) == False:
				return [False]
			converted = []
			shapeImporter = ShapeImporter()
			converted = list(shapeImporter.Convert(doc, sat_path))
			shapeImporter.Dispose()
			if bypasscheck:
				cleanconverted = []
				for e in converted:
					if e.ToString() == "Autodesk.Revit.DB.Mesh":
						continue
					else:
						cleanconverted.append(e)
				converted = cleanconverted
			else:
				for e in converted:
					if e.ToString() == "Autodesk.Revit.DB.Mesh":
						return [False]
			if len(converted) != 0:
				converted = isActuallygood(sat_path,converted,firstTime,geometrymode,bypasscheck)
			if (bypasscheck and importinstance) or (importinstance and converted[0] != False):
				satopt = SATImportOptions()
				imported = doc.Import(sat_path,satopt,None)
				element = doc.GetElement(imported)
				element.Pinned = False
				converted = [element]
				satopt.Dispose()
			if len(converted) == 0:
				return [False]
			return converted
		def batchattempt(temp_path,surfs,importinstance,bypasscheck,scaleup,sendmessage):
			randomname = ''.join([random.choice(string.ascii_letters + string.digits) for n in xrange(5)])
			x_sat_path = '%s%s.sat' % (temp_path, randomname)
			dg.Geometry.ExportToSAT(surfs,x_sat_path)
			if importinstance and bypasscheck:
				satopt = SATImportOptions()
				imported = doc.Import(x_sat_path,satopt,None)
				element = doc.GetElement(imported)
				element.Pinned = False
				x_finalsurfaces = [element]
				satopt.Dispose()
			else:
				x_finalsurfaces = quickSATcheck(x_sat_path,scaleup,importinstance,True,False,bypasscheck)
			System.IO.File.Delete(x_sat_path)
			if x_finalsurfaces[0] == False:
				return [False]
			else:
				x_choppedfinal = []
				for xf in x_finalsurfaces:
					x_choppedfinal.append([xf])
				return x_choppedfinal,sendmessage,True
		def SurfacesLaundry(surfs,doc,importinstance,geometrymode,temp_path):
			#scaleup = round(unitconverter(3.280839895,doc,True),8)
			def tolist(obj1):
				if hasattr(obj1,'__iter__'): return obj1
				else: return [obj1]	
			def checkcompatible(geoms,customscale=[1,1,1],firstTime=False,geometrymode=True,bypasscheck=False):
				randomname = ''.join([random.choice(string.ascii_letters + string.digits) for n in xrange(5)])
				sat_path = '%s%s.sat' % (temp_path, randomname)
				if allisone(customscale) == False:
					scaledgeoms = geoms.Scale(customscale[0],customscale[1],customscale[2])
					geoms = scaledgeoms
				dg.Geometry.ExportToSAT(geoms,sat_path)
				converted = []
				shapeImporter = ShapeImporter()
				converted = list(shapeImporter.Convert(doc, sat_path))
				shapeImporter.Dispose()
				System.IO.File.Delete(sat_path)
				for e in converted:
					if e.ToString() == "Autodesk.Revit.DB.Mesh":
						return [False]
				if len(converted) != 0:
					converted = isActuallygood(geoms,converted,firstTime,geometrymode,bypasscheck)
				if len(converted) == 0:
					return [False]
				return converted
			def revitOP(finalsub,nurbs=None,cleanexplodes=None,customscale=[1,1,1],disposeNurbs=True,geometrymode=True):
				if nurbs == None and cleanexplodes == None:
					testit = checkcompatible(finalsub,customscale,False,geometrymode)
					if testit[0] == False:
						raise Exception("Geometry Incompatible With Revit")
					else:
						if geometrymode == False:
							finalsub.Dispose()
						return testit
				cleanfinalsub = dg.Geometry.Explode(finalsub)
				revitgeom = []
				for c in cleanfinalsub:
					testit = checkcompatible(c,customscale,False,geometrymode)
					if testit[0] == False:
						c.Dispose()
						raise Exception("Geometry Incompatible With Revit")
					else:
						if geometrymode == False:
							c.Dispose()
						revitgeom.append(testit)
				revitgeom = flatten(revitgeom)
				if disposeNurbs:
					nurbs.Dispose()
				for cleanex in cleanexplodes:
					cleanex.Dispose()
				finalsub.Dispose()
				return revitgeom
			def cleanupSurface(surface):
				def subtractfunction(nurbs,cleanexplodes):
					def loopclean(nurbs,thick,counter):
						result = dg.Surface.SubtractFrom(nurbs,thick)[0]
						if counter != 0:
							nurbs.Dispose()
						thick.Dispose()
						return result
					thickforms = []
					for cleanex in cleanexplodes:
						safearea = metersurfarea(cleanex)/10
						if safearea > meternumber(0.1):
							maxthicken = meternumber(0.1)
						else:
							maxthicken = safearea
						thickforms.append(dg.Surface.Thicken(cleanex,maxthicken,True))
					counter = 0
					for thick in thickforms:
						nurbs = loopclean(nurbs,thick,counter)
						counter += 1
					return nurbs
				def tryingforall(surface,nurbs,cleanexplodes,geometrymode):
					try:
						finalsub = subtractfunction(nurbs,cleanexplodes)
						return revitOP(finalsub,nurbs,cleanexplodes,scaleup,True,geometrymode)
					except:
						try:
							finalsub = dg.Surface.Difference(nurbs,cleanexplodes)
							return revitOP(finalsub,nurbs,cleanexplodes,scaleup,True,geometrymode)
						except Exception as e:
							if str(e) == "Cannot difference an empty list" and almostsame(nurbs,surface):
								finalsub = nurbs
								try:
									return revitOP(finalsub,nurbs,cleanexplodes,scaleup,False,geometrymode)
								except:
									return None,finalsub
							else:
								return None,finalsub
				def gencleanexplodes(subtractnurbs):
					if isinstance(subtractnurbs, list):
						if len(subtractnurbs) == 0:
							return []
					else:
						explodednurbs = dg.Geometry.Explode(subtractnurbs)
						cleanexplodes = []
						if safemode:
							for ex in explodednurbs:
								if ex.Area < meternumber(0.002):
									ex.Dispose()
								else:
									cleanexplodes.append(ex)
						else:
							cleanexplodes = list(explodednurbs)
						subtractnurbs.Dispose()
						return cleanexplodes
				def easymethod(surface,geometrymode):
					try:
						nurbs = dg.Surface.ToNurbsSurface(surface)
						if almostsame(nurbs,surface):
							try:
								return True,revitOP(nurbs,None,None,scaleup,True,geometrymode)
							except:
								return None,nurbs
						else:
							return None,nurbs
					except:
						return None,None
				def isplanarsurf(s):
					norms = [0,0.333,0.666,1]
					pts = []
					for n in norms:
						for n2 in norms:
							pts.append(dg.Surface.PointAtParameter(s,n,n2))
					plane = dg.Plane.ByBestFitThroughPoints(pts)
					status = True
					for p in pts:
						try:
							inter = dg.Geometry.DoesIntersect(p,plane)
							if inter == False:
								status = False
								break
						except:
							pass
					return status
				def joincurves(crvs):
					def PointsEqual(pt1, pt2):
						tolerance = 0.00001
						if (math.fabs(pt1.X - pt2.X) < tolerance and
						    math.fabs(pt1.Y - pt2.Y) < tolerance and
						    math.fabs(pt1.Z - pt2.Z) < tolerance):
							return True
						else:
							return False
					crvs = flatten(tolist(crvs))
					crvGroup = [-1 for x in range(len(crvs))]
					crvGroup[0] = 0
					maxGroupNum = 1
					starts = []
					ends = []
					for crv in crvs:
						starts.append(crv.PointAtParameter(0))
						ends.append(crv.PointAtParameter(1))
					for i in range(len(crvs)):
						if (crvGroup[i] == -1):
							crvGroup[i] = i
						for j in range(len(crvs)):
							if (i != j and
								(PointsEqual(starts[i], starts[j]) or
								PointsEqual(starts[i], ends[j]) or
								PointsEqual(ends[i], starts[j]) or
								PointsEqual(ends[i], ends[j]))):
								if (crvGroup[j] == -1):
									crvGroup[j] = crvGroup[i]
								elif (crvGroup[i] != crvGroup[j]):
									oldNum = crvGroup[j]
									for k in range(len(crvs)):
										if (crvGroup[k] == oldNum):
											crvGroup[k] = crvGroup[i]
					groups = []
					excluded = []
					for n in crvGroup:
						innercount = 0
						tmp = []
						for n2 in crvGroup:
							if n == n2 and n2 not in excluded:
								tmp.append(crvs[innercount])
							innercount += 1
						if len(tmp) == 0:
							continue
						try:
							tmp = dg.PolyCurve.ByJoinedCurves(tmp)
							groups.append(tmp)
						except:
							for t in tmp:
								groups.append(dg.PolyCurve.ByJoinedCurves([t]))
						excluded.append(n)
					joinedcurves = groups
					return joinedcurves
				def trimloopmethod(surface,nurbs,geometrymode):
					try:
						if surface.Closed:
							return [None]
						try:
							joinedperms = [dg.PolyCurve.ByJoinedCurves(surface.PerimeterCurves())]
						except:
							joinedperms = joincurves(surface.PerimeterCurves())
						finalsub = dg.Surface.TrimWithEdgeLoops(nurbs,joinedperms)
						if almostsame(finalsub,surface):
							return revitOP(finalsub,None,None,scaleup,True,geometrymode)
						else:
							return [None]
					except:
						return [None]
				def thickenintersectMethod(surface,nurbs,geometrymode,pointOneMeter):
					try:
						tmp_thicken = dg.Surface.Thicken(surface,pointOneMeter,True)
						isplanar = isplanarsurf(surface)
						if isplanar:
							tmp_pt = dg.Surface.PointAtParameter(surface,0.5,0.5)
							tmp_norm = dg.Surface.NormalAtPoint(surface,tmp_pt)
							intersecter = dg.Plane.ByOriginNormal(tmp_pt,tmp_norm)
							finalsub = dg.Geometry.Intersect(intersecter,tmp_thicken)
							for f in finalsub:
								if isinstance(f,dg.Surface):
									finalsub = f
									break
							tmp_thicken.Dispose()
						else:
							finalsub = dg.Geometry.Intersect(nurbs,tmp_thicken)
							for f in finalsub:
								if isinstance(f,dg.Surface):
									finalsub = f
									break
							tmp_thicken.Dispose()
						try:
							return revitOP(finalsub,None,None,scaleup,True,geometrymode)
						except:
							return None,finalsub
					except:
						return [None]
				def inithickenMethod(surface,nurbs,geometrymode):
					try:
						safearea = metersurfarea(surface)/10
						if safearea > meternumber(0.1):
							maxthicken = meternumber(0.1)
						else:
							maxthicken = safearea
						thickeninit = dg.Surface.Thicken(surface,maxthicken,True)
						try:
							subtractnurbs = dg.Surface.SubtractFrom(nurbs,thickeninit)[0]
						except Exception as e:
							if "index out of range" in str(e) and almostsame(nurbs,surface):
								subtractnurbs = []
							elif "index out of range" in str(e):
								try:
									subtractnurbs = dg.Surface.Difference(nurbs,[surface])
								except Exception as e:
									if str(e) == "Unable to get FACE from BODY: no faces in BODY":
										subtractnurbs = []
						thickeninit.Dispose()
						cleanexplodes = gencleanexplodes(subtractnurbs)
						tryall = tryingforall(surface,nurbs,cleanexplodes,geometrymode)
						if tryall[0] != None:
							return tryall
						else:
							return None,tryall[1]
					except:
						return [None]
				def simplesubmethod(surface,nurbs,geometrymode):
					try:
						try:
							subtractnurbs = dg.Surface.Difference(nurbs,[surface])
						except Exception as e:
							if str(e) == "Unable to get FACE from BODY: no faces in BODY":
								try:
									try:
										return revitOP(nurbs,None,None,scaleup,True,geometrymode)
									except:
										return None,nurbs
								except:
									return [None]
						cleanexplodes = gencleanexplodes(subtractnurbs)
						tryall = tryingforall(surface,nurbs,cleanexplodes,geometrymode)
						if tryall[0] != None:
							return tryall
						else:
							return None,tryall[1]
					except:
						return [None]
				easy = easymethod(surface,geometrymode)
				pointOneMeter = unitconverter(0.3280,doc,True)
				if easy[0] != None:
					return easy[1]
				elif easy[0] == None and easy[1] == None:
					return None
				else:
					nurbs = easy[1]
				failsafesurfs = []
				trimloop = trimloopmethod(surface,nurbs,geometrymode)
				if trimloop[0] != None:
					return trimloop
				simple = simplesubmethod(surface,nurbs,geometrymode)
				if simple[0] != None:
					return simple
				else:
					try:
						failsafesurfs.append(simple[1])
					except:
						pass
				inithick = inithickenMethod(surface,nurbs,geometrymode)
				if inithick[0] != None:
					return inithick
				else:
					try:
						failsafesurfs.append(inithick[1])
					except:
						pass
				thickeninter = thickenintersectMethod(surface,nurbs,geometrymode,pointOneMeter)
				if thickeninter[0] != None:
					return thickeninter
				else:
					try:
						failsafesurfs.append(thickeninter[1])
					except:
						pass
				for failsurf in failsafesurfs:
					surface = failsurf
					easy = easymethod(surface,geometrymode)
					if easy[0] != None:
						return easy[1]
					elif easy[0] == None and easy[1] == None:
						return None
					else:
						nurbs = easy[1]
					trimloop = trimloopmethod(surface,nurbs,geometrymode)
					if trimloop[0] != None:
						return trimloop
					simple = simplesubmethod(surface,nurbs,geometrymode)
					if simple[0] != None:
						return simple
					inithick = inithickenMethod(surface,nurbs,geometrymode)
					if inithick[0] != None:
						return inithick
					thickeninter = thickenintersectMethod(surface,nurbs,geometrymode,pointOneMeter)
					if thickeninter[0] != None:
						return thickeninter
				return None
			sendmessage = False
			is_sat = False
			if isinstance(surfs,str) == False:
				surfs = flatten(tolist(surfs))
				x_scaledown = round(unitconverter(0.3048,doc,False),8)
				x_pure = []
				for xs in surfs:
					if isinstance(xs,dg.Solid) or isinstance(xs,dg.Surface) or isinstance(xs,dg.PolySurface) or isinstance(xs,dg.Cuboid):
						if x_scaledown != 1:
							x_pure.append(xs.Scale(x_scaledown))
						else:
							x_pure.append(xs)
				surfs = x_pure
				bOP = batchattempt(temp_path,surfs,importinstance,bypasscheck,scaleup,sendmessage)
				if bOP[0] == False:
					pass
				else:
					return bOP
			if isinstance(surfs,str):
				if ".sat" in surfs.lower():
					finalsurfaces = quickSATcheck(surfs,scaleup,importinstance,True,False,bypasscheck)
					if finalsurfaces[0] == False:
						surfs = dg.Geometry.ImportFromSAT(surfs)
						x_pure = []
						for xs in surfs:
							if isinstance(xs,dg.Solid) or isinstance(xs,dg.Surface) or isinstance(xs,dg.PolySurface) or isinstance(xs,dg.Cuboid):
								x_pure.append(xs)
						surfs = x_pure
						is_sat = True
					else:
						choppedfinal = []
						for f in finalsurfaces:
							choppedfinal.append([f])
						return choppedfinal,sendmessage,True
				else:
					return [],sendmessage
				scaledown = 1
			else:
				scaledown = round(unitconverter(0.3048,doc,False),8)
			surfs = flatten(tolist(surfs))
			finalsurfaces = []
			precheck = []
			for s in surfs:
				try:
					if isinstance(s,dg.Surface):
						exploded = dg.Geometry.Explode(s)
						if disposeinit:
							s.Dispose()
						if len(exploded) > 1:
							try:
								precheck.append(dg.PolySurface.ByJoinedSurfaces(exploded))
							except:
								for exp in exploded:
									precheck.append(exp)
						else:
							for exp in exploded:
								precheck.append(exp)
					else:
						precheck.append(s)
				except:
					precheck.append(s)
			surfs = precheck
			bOP = batchattempt(temp_path,surfs,importinstance,bypasscheck,scaleup,sendmessage)
			if bOP[0] == False:
				pass
			else:
				return bOP
			for s in surfs:
				surface = s
				safe = True
				if safemode:
					if isinstance(surface,dg.Solid) or isinstance(surface,dg.PolySurface):
						nicesurfaces = []
						explodedcheck = dg.Geometry.Explode(surface)
						for explocheck in explodedcheck:
							if isbellowarea(explocheck):
								safe = False
								explocheck.Dispose()
								sendmessage = True
							else:
								nicesurfaces.append(explocheck)
						if safe:
							for n in nicesurfaces:
								n.Dispose()
					else:
						if isbellowarea(surface):
							s.Dispose()
							if scaledown != 1 and geometrymode == False:
								surface.Dispose()
							sendmessage = True
							continue
				if safe == False:
					tmp = []
					for mini_s in nicesurfaces:
						testit = checkcompatible(mini_s,scaleup,False,geometrymode)
						if testit[0] == False:
							cleanedup = cleanupSurface(mini_s)
							if cleanedup != None:
								tmp.append(cleanedup)
						else:
							tmp.append(testit)
						if geometrymode == False and testit[0] != False:
							mini_s.Dispose()
					if len(tmp) != 0:
						finalsurfaces.append(flatten(tmp))
					else:
						finalsurfaces.append(["FAILED"])
					if (disposeinit or is_sat) and geometrymode == False:
						s.Dispose()
					if scaledown != 1 and geometrymode == False:
						if isinstance(surface,list):
							for surf in surface:
								surf.Dispose()
						else:
							surface.Dispose()
					continue
				testit = checkcompatible(surface,scaleup,True,geometrymode)
				if testit[0] == False:
					isexploded = False
					if isinstance(surface,dg.Solid) or isinstance(surface,dg.PolySurface):
						surface = list(dg.Geometry.Explode(surface))
						isexploded = True
					if isexploded:
						tmp = []
						for mini_s in surface:
							testit = checkcompatible(mini_s,scaleup,False,geometrymode)
							if testit[0] == False:
								cleanedup = cleanupSurface(mini_s)
								if cleanedup != None:
									tmp.append(cleanedup)
							else:
								tmp.append(testit)
							if geometrymode == False and testit[0] != False:
								mini_s.Dispose()
						if len(tmp) != 0:
							try:
								soljoin = polysurfaceOP(flatten(tmp))
								try:
									sol = dg.Solid.ByJoinedSurfaces([soljoin])
									soljoin.Dispose()
								except:
									sol = soljoin
								testit = checkcompatible(sol,scaleup,True,geometrymode)
								if testit[0] == False:
									sol.Dispose()
									finalsurfaces.append(flatten(tmp))
								else:
									finalsurfaces.append([sol])
							except:
								finalsurfaces.append(flatten(tmp))
						else:
							finalsurfaces.append(["FAILED"])
						sendmessage = True
					else:
						cleanedup = cleanupSurface(surface)
						if cleanedup != None:
							finalsurfaces.append(cleanedup)
						else:
							finalsurfaces.append(["FAILED"])
				else:
					finalsurfaces.append(testit)
				if (disposeinit or is_sat) and geometrymode == False:
					s.Dispose()
				if scaledown != 1 and geometrymode == False:
					if isinstance(surface,list):
						for surf in surface:
							surf.Dispose()
					else:
						surface.Dispose()
			return finalsurfaces,sendmessage
		forms = []
		laundryMain = SurfacesLaundry(surfs,doc,importinstance,geometrymode,temp_path)
		result = laundryMain[0]
		sendmessage = laundryMain[1]
		for rlist in result:
			tmp = []
			for r in rlist:
				tmp.append(r)
			if len(tmp) != 0:
				forms.append(tmp)
		if len(laundryMain) == 3:
			return forms,sendmessage,True
		else:
			return forms,sendmessage
	if geoms == [] or geoms == None:
		return [],None,False
	geometrymode = True
	disposeinit = False
	TransactionManager.Instance.ForceCloseTransaction()
	if importinstance:
		trans = Transaction(doc, 'Create ImportInstance')
	else:
		if doc.IsFamilyDocument:
			trans = Transaction(doc, 'Create FreeForm')
		else:
			trans = Transaction(doc, 'Create DirectShape')
	trans.Start()
	warnhandle = WarnSwallowImport()
	foptions = trans.GetFailureHandlingOptions()
	foptions.SetFailuresPreprocessor(warnhandle)
	foptions.SetClearAfterRollback(True)
	trans.SetFailureHandlingOptions(foptions)
	try:
		smartrevitsolidMain = smartrevitsolid(geoms,doc,importinstance,safemode,geometrymode,disposeinit,temp_path)
	except:
		trans.RollBack()
		return [],None,False
	if len(smartrevitsolidMain) == 3:
		trans.Commit()
	else:
		trans.RollBack()
	freeformslists = smartrevitsolidMain[0]
	sendmessage = smartrevitsolidMain[1]
	result = [] 
	singlelist = []
	TransactionManager.Instance.ForceCloseTransaction()
	if importinstance:
		if singlefinalprocess:
			trans = Transaction(doc, 'Create ImportInstance')
		else:
			trans = Transaction(doc, 'Create ImportInstances')
	else:
		if doc.IsFamilyDocument:
			trans = Transaction(doc, 'Create FreeForms')
		else:
			trans = Transaction(doc, 'Create DirectShape')
	if len(smartrevitsolidMain) == 3:
		if singlefinalprocess:
			trans = Transaction(doc, 'Move ImportInstance')
		else:
			trans = Transaction(doc, 'Move ImportInstances')
	trans.Start()
	satopt = SATImportOptions()
	for slist in freeformslists:
		tmp = []
		tmpexport = []
		for s in slist:
			if s == "FAILED":
				if returnfailures:
					tmp.append(None)
				continue
			compare = s.ToString()
			if compare == "Autodesk.Revit.DB.FreeFormElement" or compare == "Autodesk.Revit.DB.Solid" or compare == "Autodesk.Revit.DB.ImportInstance" or compare == "Autodesk.Revit.DB.DirectShape":
				tmp.append(s)
			else:
				if singlefinalprocess:
					singlelist.append(s)
				else:
					tmpexport.append(s)
		if len(tmp) != 0:
			result.append(tmp)
		if len(tmpexport) != 0:
			result.append(finalimport(importinstance,tmpexport,satopt,singlefinalprocess))
	if len(singlelist) != 0:
		result.append(finalimport(importinstance,singlelist,satopt,singlefinalprocess))
	satopt.Dispose()
	mainvec = None
	if len(result) != 0 and centermode:
		doc.Regenerate()
		mainvec = movecenter(doc,result)
	trans.Commit()
	if importinstance or (singlefinalprocess and doc.IsFamilyDocument == False):
		cleanresult = []
		for r in result:
			cleanresult.append(r[0])
		result  = cleanresult
		if (singlefinalprocess and importinstance) or (singlefinalprocess and doc.IsFamilyDocument == False):
			result = result[0]
	return result,mainvec,sendmessage

def toRvtId(_id):
	if isinstance(_id, int) or isinstance(_id, str):
		id = ElementId(int(_id))
		return id
	elif isinstance(_id, ElementId):
		return _id

def flatten(x):
    result = []
    for el in x:
        if hasattr(el, "__iter__") and not isinstance(el, basestring):
            result.extend(flatten(el))
        else:
            result.append(el)
    return result

#unwrap incoming information for use with API
elems = UnwrapElement(IN[0])
ids = []

for each in elems:
	ids.append(each.Id)

streetwidth = UnwrapElement(IN[1])

#use element ids to select elements
elements = []
message = None
try:
	for i in ids:
		elements.append(doc.GetElement(toRvtId(i)).ToDSType(True))
except:
	message = "Invalid Id"
	pass

geom = []
for each in elements:
	try:
		geom.append(Revit.Elements.Element.Geometry(each))
	except:
		geom.append(each)

flattengeom = flatten(geom)
thick = []

if int(DocumentManager.Instance.CurrentUIApplication.Application.VersionNumber) < 2021:
	unittype = UnitType.UT_Length
	formatoptions = doc.GetUnits().GetFormatOptions(unittype)
	dispunits = formatoptions.DisplayUnits
	thickenval = UnitUtils.ConvertFromInternalUnits(300,dispunits)
else:
	thickenval = UnitUtils.ConvertFromInternalUnits(300,doc.GetUnits().GetFormatOptions(SpecTypeId.Length).GetUnitTypeId())

for each in flattengeom:
	try:
		if each.IsClosed == True:
			offsets = []
			offsets.append(dg.Curve.Offset(each,(streetwidth/2)))
			offsets.append(dg.Curve.Offset(each,(streetwidth/-2)))
			surf = dg.Surface.ByLoft(offsets)
		else:
			surf = dg.Surface.ByPatch(dg.PolyCurve.ByThickeningCurve(each,streetwidth,dg.Vector.ZAxis()))
		thick.append(dg.Surface.Thicken(surf,thickenval,True))
	except:
		try:
			extru = dg.Curve.Extrude(each,dg.Vector.ZAxis(),1)
			this = dg.Surface.Thicken(extru,streetwidth,True)
			tmpexp = dg.Geometry.Explode(this)
			for e in tmpexp:
				tmpvec = dg.Surface.NormalAtParameter(e,0.5,0.5)
				if dg.Vector.IsAlmostEqualTo(tmpvec,dg.Vector.ZAxis().Reverse()):
					surf = e
			thick.append(dg.Surface.Thicken(surf,thickenval,True))
		except:
			pass

unionsolid = []
unionsolid.append(dg.Solid.ByUnion(thick))

for each in flattengeom:
	each.Dispose()

bbox = dg.BoundingBox.ByGeometry(unionsolid[0])
minp = bbox.MinPoint
maxp = bbox.MaxPoint
line = dg.Line.ByStartPointEndPoint(minp,maxp)
midp = dg.Curve.PointAtParameter(line,0.5)
midplane = dg.Plane.ByOriginNormal(midp,dg.Vector.ZAxis())
intersects = dg.Geometry.Intersect(unionsolid[0],midplane)
unionsolid[0].Dispose()
streets = []

import itertools
tmpc = []
for each in intersects:
	tmpc.append(each.PerimeterCurves())
crvs = flatten(tmpc)

# Determine whether two points are equal
def PointsEqual(pt1, pt2):
	tolerance = 0.001
	
	if (math.fabs(pt1.X - pt2.X) < tolerance and
	    math.fabs(pt1.Y - pt2.Y) < tolerance and
	    math.fabs(pt1.Z - pt2.Z) < tolerance):
		return True
	else:
		return False

# List the group to which each curve belongs
crvGroup = [-1 for x in range(len(crvs))]
crvGroup[0] = 0
maxGroupNum = 1

# Find start and end points for each curve
starts = []
ends = []
for crv in crvs:
	starts.append(dg.Curve.PointAtParameter(crv,0))
	ends.append(crv.PointAtParameter(1))

# Find connected groups of curves
for i in range(len(crvs)):
	# Add i to its own group it not already part of a group
	if (crvGroup[i] == -1):
		crvGroup[i] = i

# Find connections
	for j in range(len(crvs)):
		if (i != j and
			(PointsEqual(starts[i], starts[j]) or
			PointsEqual(starts[i], ends[j]) or
			PointsEqual(ends[i], starts[j]) or
			PointsEqual(ends[i], ends[j]))):
			
			# Add j to i group
			if (crvGroup[j] == -1):
				crvGroup[j] = crvGroup[i]
			# Add j group to i group
			elif (crvGroup[i] != crvGroup[j]):
				oldNum = crvGroup[j]
				for k in range(len(crvs)):
					if (crvGroup[k] == oldNum):
						crvGroup[k] = crvGroup[i]

# Get input
data = crvs		# Data (list of same length as criteria) to be binned
criteria = crvGroup	# List of criteria related to the data
toSort = False	# Whether to sort keys

# Find a unique set of values for the criteria, a list of all the bins
# to sort data into
bins = []
bins.append(criteria[0])
sortedlis = []
sortedlis.append([])

for i in range(1,len(criteria)):
	if criteria[i] in bins:
		continue
	else:
		bins.append(criteria[i])
		sortedlis.append([]) # initialize an empty list

# Sort bins if requested
if toSort:
	bins.sort()

#	 Sort data into bins
for i in range(len(criteria)):
	for j in range(len(bins)):
		if criteria[i] == bins[j]:
			temp = sortedlis[j]
			temp.append(data[i])
			sortedlis[j] = temp
			continue
streets = sortedlis

'''
for each in intersects:
	each.Dispose()
'''

if int(DocumentManager.Instance.CurrentUIApplication.Application.VersionNumber) < 2021:
	unittype = UnitType.UT_Length
	formatoptions = doc.GetUnits().GetFormatOptions(unittype)
	dispunits = formatoptions.DisplayUnits
	minlength = UnitUtils.ConvertFromInternalUnits(doc.Application.ShortCurveTolerance,dispunits)
else:
	minlength = UnitUtils.ConvertFromInternalUnits(doc.Application.ShortCurveTolerance,doc.GetUnits().GetFormatOptions(SpecTypeId.Length).GetUnitTypeId())

newstreets = []
for each in streets:
	tmplist = []
	for c in each:
		if c.Length < minlength:
			pass
		else:
			tmplist.append(c)
	newstreets.append(tmplist)

from itertools import compress

curveLoops = []
problems = []
rcurves = []
boolmerge = []
newstreets = streets
areas = []
for each in newstreets:
	joined = dg.PolyCurve.ByJoinedCurves(each)
	patched = dg.Surface.ByPatch(joined)
	areas.append(patched.Area)
	patched.Dispose()

sortedstreets = (x for _,x in sorted(zip(areas,newstreets)))
newstreets = sortedstreets

for eachlist in newstreets:
	try:
		looplist = CurveLoop()
		rt = []
		for each in eachlist:
			if hasattr(each, 'NumberOfCurves'):
				if each.NumberOfCurves > 1:
					raise Exception("Skip it")
			looplist.Append(each.ToRevitType())
			rt.append(each)
		curveLoops.append(looplist)
		rcurves.append(rt)
		boolmerge.append(True)
	except:
		problems.append(eachlist)
		boolmerge.append(False)
from System import Array

joinedarr = []
imported = []

if len(problems) > 0:

	for each in problems:
		pc = dg.PolyCurve.ByJoinedCurves(each)
		joinedarr.append(dg.Surface.ByPatch(pc))
		
	if int(DocumentManager.Instance.CurrentUIApplication.Application.VersionNumber) < 2022:
		for each in joinedarr:
			try:
				imported.append(Revit.Elements.ImportInstance.ByGeometry(each))
			except: imported.append(None)
	else:
		imported = smartFreeForm(joinedarr,[1,1,1],doc,False,"Generic Models",True,False,False,temp_path,False,True)[0]

	ids = []
	for each in imported:
		ids.append(each.Id)

	TransactionManager.Instance.EnsureInTransaction(doc)
	#use element ids to select elements
	elements = []
	message = None
	try:
		for i in ids:
			elements.append(doc.GetElement(toRvtId(i)).ToDSType(True))
	except:
		message = "Invalid Id"
		pass
	
	geom = []
	for each in elements:
		geom.append(Revit.Elements.Element.Geometry(each))

	for each in geom:
		Array.Clear(each,0,1)

	finalgeom = []
	for each in geom:
		tmplist = []
		for s in each:
			if s == None:
				pass
			else:
				tmplist.append(s)
		finalgeom.append(tmplist)

	curveLoops2 = []
	problems2 = []
	rcurves2 = []
	
	for eachlist in finalgeom:
		joined = dg.PolyCurve.ByJoinedCurves(eachlist)
		eachlist = dg.PolyCurve.Curves(joined)
		try:
			looplist = CurveLoop()
			rt2 = []
			for each in eachlist:
				looplist.Append(each.ToRevitType())
				rt2.append(each)
			curveLoops2.append(looplist)
			rcurves2.append(rt2)
		except:
			problems2.append(eachlist)
			curveLoops2.append([])
			rcurves2.append([])
		
	elt = []
	for i in imported:
		elt.append(UnwrapElement(i).Id)
	cantdelete=[]
	for item in elt:
		try:
			doc.Delete(item)
		except:
			cantdelete.append(item)

	for each in joinedarr:
		each.Dispose()
	
	true_list = curveLoops
	true_list_r = rcurves
	false_list = curveLoops2
	false_list_r = rcurves2
	bool_list = boolmerge
	result = []
	result_r = []

	for bool in bool_list:
		if bool == True:
			result.append(true_list.pop(0))
			result_r.append(true_list_r.pop(0))
		else: 
			result.append(false_list.pop(0))
			result_r.append(false_list_r.pop(0))
			
	cleanresult = [x for x in result if x != []]
	cleanresult_r = [x for x in result_r if x != []]
	TransactionManager.Instance.TransactionTaskDone()
else:
	cleanresult = [x for x in curveLoops if x != []]
	cleanresult_r = [x for x in rcurves if x != []]

npatches = []
nareas = []
for each in cleanresult_r:
	joined = dg.PolyCurve.ByJoinedCurves(each)
	pat = dg.Surface.ByPatch(joined)
	npatches.append(pat)
	nareas.append(pat.Area)

nmax = max(nareas)
npop = nareas.IndexOf(nmax)
npatches.pop(npop)

areas = []
for each in intersects:
	areas.append(each.Area)

maxarea = max(areas)
inde = areas.IndexOf(maxarea)
bigstreet = intersects[inde]

allsurfs = [bigstreet] + npatches

# Assign your output to the OUT variable.
OUT = cleanresult, cleanresult_r, allsurfs
# ----------------------------------------
VARCurvesAndSurfaces = Output(python_script)
VARCADImport_2 = Output(VARCADImport)  # "VARCADImport"
