# Dynamo custom node String.ToNumber Fixer.dyf (Dynamo 2.1.0.7500)
# category: Synthesize.Fixers
# String.ToNumber Fixer

VARstr = Input(VARstr: string)
toNumber = String.ToNumber(str=VARstr)
VARnumber = Output(toNumber)
