# Dynamo custom node Suface.IsPlanarOrCurved.dyf (Dynamo 2.1.0.7500)
# category: Synthesize.Automate.Surface
# Suface.IsPlanarOrCurved

VARsurface = Input(VARsurface: var[]..[])
python_script = Python(IN[0]=VARsurface)
# ---------- python_script.python (76 lines) ----------
import clr
clr.AddReference('ProtoGeometry')
from Autodesk.DesignScript import Geometry as dg

def tolist(obj1):
	if hasattr(obj1,'__iter__'): return obj1
	else: return [obj1]

def flatten(x):
    result = []
    for el in x:
        if hasattr(el, "__iter__") and not isinstance(el, basestring):
            result.extend(flatten(el))
        else:
            result.append(el)
    return result

def isplanarsurf(s):
	norms = [0,0.333,0.666,1]
	pts = []
	for n in norms:
		for n2 in norms:
			pts.append(dg.Surface.PointAtParameter(s,n,n2))
	plane = dg.Plane.ByBestFitThroughPoints(pts)
	status = True
	for p in pts:
		try:
			inter = dg.Geometry.DoesIntersect(p,plane)
			if inter == False:
				status = False
				break
		except:
			pass
	return status

def iscurvesurf(s):
	norms = [0,0.333,0.666,1]
	try:
		for n in norms:
			curve1 = dg.Geometry.Explode(dg.Curve.ByIsoCurveOnSurface(s,0,n))[0]
			curve2 = dg.Geometry.Explode(dg.Curve.ByIsoCurveOnSurface(s,1,n))[0]
			if (isinstance(curve1, dg.Line) or isinstance(curve1, dg.Circle)) and (isinstance(curve2, dg.Line) or isinstance(curve2, dg.Circle)):
				continue
			else:
				isgood = False
				try:
					arclength1 = dg.Arc.ByThreePoints(curve1.StartPoint,dg.Curve.PointAtParameter(curve1,0.5),curve1.EndPoint).Length
					if round(arclength1,2) == round(curve1.Length):
						continue
					else:
						return False
				except:	
					isgood = True
					pass
				try:
					arclength2 = dg.Arc.ByThreePoints(curve2.StartPoint,dg.Curve.PointAtParameter(curve2,0.5),curve2.EndPoint).Length
					if round(arclength2,2) == round(curve2.Length):
						continue
					else:
						return False
				except:
					isgood = True
					pass
				if isgood:
					continue
		return True
	except:
		return False
surfs = flatten(tolist(IN[0]))
result = []
for s in surfs:
	if isplanarsurf(s) or iscurvesurf(s):
		result.append(True)
	else:
		result.append(False)
OUT = result
# ----------------------------------------
VARbool = Output(python_script)
