# Dynamo custom node Surface Color Analysis Display For K-Rationalize.dyf (Dynamo 2.1.0.7500)
# category: Synthesize.Automate.Surface
# Color Analysis Display For K-Rationalize

VAROldSurfaces = Input(VAROldSurfaces: var[]..[])
VARDisplayOldSurface = Output(VAROldSurfaces)
code_block = CodeBlock { 255; }
byARGB = Color.ByARGB(a=code_block, r=code_block)
byARGB_2 = Color.ByARGB(a=code_block, r=code_block, g=code_block)
byARGB_3 = Color.ByARGB(a=code_block, b=code_block)
join = List.Join(list0=byARGB, list1=byARGB_2, list2=byARGB_3)
join_2 = List.Join()  # unwired: list0, list1, list2
code_block_2 = CodeBlock { -1; 0; }
count = List.Count(list=VAROldSurfaces)
ofRepeatedItem = List.OfRepeatedItem(item=code_block_2.out1, amount=count)
VARAnalysisDensity = Input(VARAnalysisDensity: int = 5)
code_block_3 = CodeBlock(n=VARAnalysisDensity) { 0..1..#n; }
gaussianCurvatureAtParameter = Surface.GaussianCurvatureAtParameter(surface=VAROldSurfaces, u=code_block_3, v=code_block_3, lacing=CrossProduct)
flatten = List.Flatten(list=gaussianCurvatureAtParameter@L4)
minimumItem = List.MinimumItem(list=flatten)
sub = gaussianCurvatureAtParameter - minimumItem
flatten_2 = List.Flatten(list=sub@L4)
maximumItem = List.MaximumItem(list=flatten_2)
eq = _ == code_block_2.out1  # unwired: x
replaceByCondition = Replace(item=maximumItem, replaceWith=code_block_2.out0, condition=eq)
VARScaleMidpointColor = Input(VARScaleMidpointColor: int = 20)
div = replaceByCondition / VARScaleMidpointColor
combine = List.Combine(comb=join_2, list1=ofRepeatedItem, list2=div, list3=replaceByCondition)
code_block_4 = CodeBlock { 1; }
div_2 = code_block_4 / replaceByCondition
mul = sub * div_2
color_range = ColorRange(colors=join, indices=combine, value=mul)
transpose = List.Transpose(lists=color_range@@L3)
transpose_2 = List.Transpose(lists=transpose@@L4)
VARDisplayOldColors = Output(transpose_2)
VARNewSurfaces = Input(VARNewSurfaces: var[]..[])
flatten_3 = List.Flatten(list=VARNewSurfaces@L3)
VARDisplayNewSurface = Output(flatten_3)
gaussianCurvatureAtParameter_2 = Surface.GaussianCurvatureAtParameter(surface=VARNewSurfaces, u=code_block_3, v=code_block_3, lacing=CrossProduct)
sub_2 = gaussianCurvatureAtParameter_2 - minimumItem
mul_2 = sub_2 * div_2
color_range_2 = ColorRange(colors=join, indices=combine, value=mul_2)
flatten_4 = List.Flatten(list=color_range_2@@L3)
transpose_3 = List.Transpose(lists=flatten_4@@L3)
transpose_4 = List.Transpose(lists=transpose_3@@L4)
VARDisplayNewColors = Output(transpose_4)
