# Dynamo custom node Surface Importer 2x.dyf (Dynamo 2.1.0.7500)
# category: Synthesize.Automate.Surface
# Surface Importer Updated

VAROperate = Input(VAROperate: bool = true)
VARSurfaces = Input(VARSurfaces: var[]..[])
empty = List.Empty()
scopeIf = Custom[CW.ScopeIf+](VARtest=VAROperate, VARtrue=VARSurfaces, VARfalse=empty)  # A (hopefully) more robust implementation of ScopeIf. Tests a single boolean and returns a value accordingly.
area = Surface.Area(surface=scopeIf)
maximumItem = List.MaximumItem(list=area)
eq = maximumItem == area
filterByBoolMask = List.FilterByBoolMask(list=scopeIf, mask=eq)
python_empty_2_null = Custom[Python Empty 2 Null](VARIN=filterByBoolMask.out)  # Python Null 2 Empty
python_script = Python(IN[0]=filterByBoolMask.in, IN[1]=python_empty_2_null)
# ---------- python_script.python (63 lines) ----------
# Enable Python support and load DesignScript library
# IMPORTANT : ALL DYNAMO DESIGN SCRIPT NODES ARE AS (dg)
import clr
clr.AddReference('ProtoGeometry')
from Autodesk.DesignScript import Geometry as dg

# EXTENSION Enable ToDSType
clr.AddReference('RevitNodes')
import Revit
clr.ImportExtensions(Revit.Elements)

# Enable Revit Elements
from Revit.Elements import *

# EXTENSION Enable Geometry Conversion Methods
clr.ImportExtensions(Revit.GeometryConversion)

# Enable Revit API
clr.AddReference('RevitAPI')
from Autodesk.Revit.DB import *

# Enable DocumentManager and TransactionManager
clr.AddReference('RevitServices')
from RevitServices.Persistence import DocumentManager
from RevitServices.Transactions import TransactionManager

# Enable ICollection List Translate
clr.AddReference("System")
import System.Collections.Generic
from System.Collections.Generic import List

dataEnteringNode = IN
# Use UnwrapElement(IN[0]) When Translating From Dynamo to Revit
surfaces=UnwrapElement(IN[0])
tosubs=UnwrapElement(IN[1])

result = []
count = 0
for e in surfaces:
	try:
		e = e[0]
	except:
		pass
	try:
		consider = []
		try:
			for t in tosubs[count]:
				if dg.Geometry.DoesIntersect(e,dg.Surface.PointAtParameter(t,0.5,0.5)):
					consider.append(t)
				else:
					result.append(t)
		except:
			if dg.Geometry.DoesIntersect(e,dg.Surface.PointAtParameter(tosubs[count],0.5,0.5)):
				consider.append(tosubs[count])
			else:
				result.append(tosubs[count])
		result.append(dg.Surface.Difference(e,consider))
	except:
		result.append(e)
	count += 1

# Assign your output to the OUT variable.
OUT = result
# ----------------------------------------
scopeIf_2 = Custom[CW.ScopeIf+](VARtest=VAROperate, VARtrue=python_script, VARfalse=VARSurfaces)
VARresult = Output(scopeIf_2)
