# Dynamo custom node Surface Laundry.dyf (Dynamo 2.1.0.7500)
# category: Synthesize.Automate.Surface
# Surface Laundry

VARSurfaceOrPolyCurvesList = Input(VARSurfaceOrPolyCurvesList: var[]..[])
python_script = Python(IN[0]=VARSurfaceOrPolyCurvesList)
# ---------- python_script.python (25 lines) ----------
# Enable Python support and load DesignScript library
# IMPORTANT : ALL DYNAMO DESIGN SCRIPT NODES ARE AS (dg)
import clr
clr.AddReference('ProtoGeometry')
from Autodesk.DesignScript import Geometry as dg

def tolist(obj1):
	if hasattr(obj1,'__iter__'): return obj1
	else: return [obj1]

def flatten(x):
    result = []
    for el in x:
        if hasattr(el, "__iter__") and not isinstance(el, basestring):
            result.extend(flatten(el))
        else:
            result.append(el)
    return result

input = flatten(tolist(IN[0]))

if isinstance(input[0], dg.Surface):
	OUT = True,input
else:
	OUT = False,input
# ----------------------------------------
code_block = CodeBlock(a=python_script) { a[0]; a[1]; }
empty = List.Empty()
scopeIf = Custom[CW.ScopeIf+](VARtest=code_block.out0, VARtrue=code_block.out1, VARfalse=empty)  # A (hopefully) more robust implementation of ScopeIf. Tests a single boolean and returns a value accordingly.
perimeterCurves = Surface.PerimeterCurves(surface=scopeIf)
toNurbsCurve = Curve.ToNurbsCurve(curve=perimeterCurves)
controlPoints = NurbsCurve.ControlPoints(nurbsCurve=toNurbsCurve)
byControlPoints = NurbsCurve.ByControlPoints(points=controlPoints)
as_polycurve_bycurves_with = Custom[AS.[&] PolyCurve.ByCurves With Failures](VARcurves=byControlPoints)  # Create polycurves from an unordered list of curves.
anyTrue = Custom[CW.List.AnyTrue](VARseq=as_polycurve_bycurves_with.VARFailures)  # Returns true if any item in a list of booleans is true.
filterByBoolMask = List.FilterByBoolMask(list=scopeIf, mask=anyTrue)
scale_up_and_down_revit_factor = Custom[Scale Up and Down Revit Factor]()  # Scale Up and Down Revit Factor
code_block_2 = CodeBlock { 1; }
eq = scale_up_and_down_revit_factor.VARUp == code_block_2
filterByBoolMask_2 = List.FilterByBoolMask(list=as_polycurve_bycurves_with.VARpolyCurve, mask=anyTrue)
create = List.Create(item0=code_block.out1)
scopeIf_2 = Custom[CW.ScopeIf+](VARtest=code_block.out0, VARtrue=filterByBoolMask_2.out, VARfalse=create)
empty_2 = List.Empty()
scopeIf_3 = Custom[CW.ScopeIf+](VARtest=eq, VARtrue=empty_2, VARfalse=scopeIf_2)
scale = Geometry.Scale(geometry=scopeIf_3, xamount=scale_up_and_down_revit_factor.VARDown, yamount=scale_up_and_down_revit_factor.VARDown, zamount=scale_up_and_down_revit_factor.VARDown)
scopeIf_4 = Custom[CW.ScopeIf+](VARtest=eq, VARtrue=scopeIf_2, VARfalse=scale)
VARPrecision = Input(VARPrecision: double = 0.1)
python_script_2 = Python(IN[0]=scopeIf_4, IN[1]=VARPrecision, IN[2]=filterByBoolMask.out)
# ---------- python_script_2.python (119 lines) ----------
# Enable Python support and load DesignScript library
# IMPORTANT : ALL DYNAMO DESIGN SCRIPT NODES ARE AS (dg)
import clr
clr.AddReference('ProtoGeometry')
from Autodesk.DesignScript import Geometry as dg

# Enable Revit API
clr.AddReference('RevitAPI')
from Autodesk.Revit.DB import *

# Enable DocumentManager and TransactionManager
clr.AddReference('RevitServices')
from RevitServices.Persistence import DocumentManager
from RevitServices.Transactions import TransactionManager

doc = DocumentManager.Instance.CurrentDBDocument

def normalize(length,nostartend = False,twominonly = False):
	if length != None:
		if length <= 3 and twominonly == False:
			length = 4
		elif length <= 3 and twominonly == True:
			if length < 2:
				length = 2
		if nostartend:
			length += 2
		a = range(0,int(length))
		points = []
		amin, amax = min(a), max(a)
		item = []
		for val in a:
			item.append(float(val-amin) / float(amax-amin))
	else:
		item = [None]
	if nostartend == True:
		item.pop(0)
		item.pop(-1)
	return item

def fixcurve(curve,precision):
	exlength = curve.Length/precision
	normed  = normalize(exlength)
	tmpin = []
	for norm in normed:
		pin = dg.Curve.PointAtParameter(curve,norm)
		tmpin.append(pin)
	wanted = dg.NurbsCurve.ByPoints(tmpin)
	return wanted

polycurveslist = IN[0]
precision = IN[1]
originalsurfaces = IN[2]

if int(DocumentManager.Instance.CurrentUIApplication.Application.VersionNumber) < 2021:
	unit_type = UnitType.UT_Length
	formatoptions = doc.GetUnits().GetFormatOptions(unit_type)
	dispunits = formatoptions.DisplayUnits
	precision = UnitUtils.ConvertFromInternalUnits(precision,dispunits)
else:
	precision = UnitUtils.ConvertFromInternalUnits(precision,doc.GetUnits().GetFormatOptions(SpecTypeId.Length).GetUnitTypeId())

allresult = []

bigcount = 0
for polycurves in polycurveslist:
	surfaces = []
	newpolycurves = []
	try:
		if len(polycurves) > 1:
			polycurves = [dg.PolyCurve.ByJoinedCurves(polycurves)]
	except:
		pass
	for p in polycurves:
		try:
			exploded = dg.Geometry.Explode(p)
			new = []
			for ex in exploded:
				new.append(fixcurve(ex,precision))
			p = dg.PolyCurve.ByJoinedCurves(new)
			newpolycurves.append(p)
			surfaces.append(dg.Surface.ByPatch(p))
		except:
			surfaces.append(None)
	polycurves = newpolycurves
	
	if len(surfaces) > 1:
		areas = []
		for s in surfaces:
			try:
				areas.append(s.Area)
			except:
				pass
		trimmed = True
		if len(areas) == 0:
			trimmed = None
		if trimmed:
			maximum = max(areas)
			small_loops = []
			count = 0
			for a in areas:
				if maximum == a:
					biggestsurf = surfaces[count]
					break
				count += 1
			if biggestsurf == None:
				trimmed = None
			else:
				try:
					trimmed = dg.Surface.TrimWithEdgeLoops(biggestsurf,polycurves)
				except:
					trimmed = originalsurfaces[bigcount]
	else:
		if surfaces[0] != None:
			trimmed = surfaces[0]
		else:
			trimmed = originalsurfaces[bigcount]
	bigcount += 1
	allresult.append(trimmed)
OUT = allresult
# ----------------------------------------
empty_3 = List.Empty()
scopeIf_5 = Custom[CW.ScopeIf+](VARtest=eq, VARtrue=empty_3, VARfalse=python_script_2)
scale_2 = Geometry.Scale(geometry=scopeIf_5, xamount=scale_up_and_down_revit_factor.VARUp, yamount=scale_up_and_down_revit_factor.VARUp, zamount=scale_up_and_down_revit_factor.VARUp)
scopeIf_6 = Custom[CW.ScopeIf+](VARtest=eq, VARtrue=python_script_2, VARfalse=scale_2)
mergeByBoolMask = Custom[SP.List.MergeByBoolMask](VARIn=filterByBoolMask.in, VAROut=scopeIf_6, VARmask=anyTrue)  # Merge two lists by a boolean mask list. The true count in the mask should be the same as the length of the true list and vice versa for the false list.
scopeIf_7 = Custom[CW.ScopeIf+](VARtest=code_block.out0, VARtrue=mergeByBoolMask, VARfalse=scopeIf_6)
code_block_3 = CodeBlock { false; }
clean = List.Clean(list=scopeIf_7, preserveIndices=code_block_3)
VAROut = Output(clean)
