# Dynamo custom node Surface Orientation Filter.dyf (Dynamo 2.1.0.7500)
# category: Synthesize.Automate.Surface
# Face Filter

VAROrienataion = Input(VAROrienataion: int = 4)
VARSurfaces = Input(VARSurfaces: var[]..[])
code_block = CodeBlock { 4; }
eq = VAROrienataion == code_block
empty = List.Empty()
scopeIf = Custom[CW.ScopeIf+](VARtest=eq, VARtrue=empty, VARfalse=VARSurfaces)  # A (hopefully) more robust implementation of ScopeIf. Tests a single boolean and returns a value accordingly.
filterByOrientation = Custom[CW.Surface.FilterByOrientation](VARsurfaces=scopeIf)  # Sorts surfaces in three lists based on their orientation (vertical, horizontal up & horizontal down) and also returns three corresponding lists of booleans.
python_script = Python(IN[0]=VAROrienataion, IN[1]=VARSurfaces, IN[2]=filterByOrientation.VARvertical, IN[3]=filterByOrientation.VARhorizontalUp, IN[4]=filterByOrientation.VARhorizontalDown, IN[5]=filterByOrientation.VARisVertical, IN[6]=filterByOrientation.VARisHorizontalUp, IN[7]=filterByOrientation.VARisHorizontalDown)
# ---------- python_script.python (43 lines) ----------
import clr
clr.AddReference('ProtoGeometry')
from Autodesk.DesignScript.Geometry import *
#The inputs to this node will be stored as a list in the IN variables.
dataEnteringNode = IN

allfaces = IN[1]
vertical = IN[2]
horiup = IN[3]
horidown = IN[4]
verticalbool = IN[5]
horiupbool = IN[6]
horidownbool = IN[7]

switch = IN[0]

if switch == 4:
	allbool = []
	for a in allfaces:
		allbool.append(True)
	OUT = allfaces,allbool
elif switch == 1:
	OUT = vertical,verticalbool
elif switch == 2:
	OUT = horiup,horiupbool
elif switch == 3:
	OUT = horidown,horidownbool
elif switch == 23:
	combinedbool = []
	count = 0
	for h in horiupbool:
		hd = horidownbool[count]
		if h == True or hd == True:
			combinedbool.append(True)
		else:
			combinedbool.append(False)
		count += 1
	OUT = horiup + horidown,combinedbool
else:
	allbool = []
	for a in allfaces:
		allbool.append(True)
	OUT = allfaces,allbool
# ----------------------------------------
code_block_2 = CodeBlock(a=python_script) { a[0]; a[1]; }
VARSurfaces_2 = Output(code_block_2.out0)  # "VARSurfaces"
VARBool = Output(code_block_2.out1)
