# Dynamo custom node Surface.Area Fixer.dyf (Dynamo 2.1.0.7500)
# category: Synthesize.Fixers
# Surface.Area Fixer

surface = Input(surface: var[]..[])
area = Surface.Area(surface=surface)
double = Output(area)
