# Dynamo custom node Surfaces Prepare For Subregions.dyf (Dynamo 2.13.1.3887)
# category: Synthesize.Automate.Surface
# Surfaces Prepare For Subregions
# packages: Synthesize toolkit 12.5.1

VARSurfaces = Input(VARSurfaces: var[]..[])
flatten = List.Flatten(list=VARSurfaces)
code_block = CodeBlock { "Autodesk.DesignScript.Geometry.Surface"; }
removeIfNot = List.RemoveIfNot(list=flatten, type=code_block)
byJoinedSurfaces = PolySurface.ByJoinedSurfaces(surfaces=removeIfNot)
VARElement = Input(VARElement: var[]..[])
curves = Element.Curves(element=VARElement)
ZAxis = Vector.ZAxis()
extrude = Curve.Extrude(curve=curves, direction=ZAxis)
flatten_2 = List.Flatten(list=extrude)
as_polysurface_splitbytools = Custom[AS.[&] PolySurface.SplitByTools](VARpolySurface=byJoinedSurfaces, VARtools=flatten_2)  # package Synthesize toolkit; Split a single polysurface with multiple tools.
perimeterCurves = Surface.PerimeterCurves(surface=as_polysurface_splitbytools)
as_polycurve_bycurves = Custom[AS.[&] PolyCurve.ByCurves](VARcurves=perimeterCurves)  # package Synthesize toolkit; Create polycurves from an unordered list of curves.
byPatch = Surface.ByPatch(closedCurve=as_polycurve_bycurves.VARpolyCurve)
area = Surface.Area(surface=byPatch)
maximumItem = List.MaximumItem(list=area)
eq = area == maximumItem
filterByBoolMask = List.FilterByBoolMask(list=byPatch, mask=eq)
flatten_3 = List.Flatten(list=filterByBoolMask.in)
perimeterCurves_2 = Surface.PerimeterCurves(surface=flatten_3)
code_block_2 = CodeBlock { 0; }
curves_offset_to_revit = Custom[Curves Offset To Revit Compatibility](VARCurves=perimeterCurves_2, VAROffset=code_block_2)  # package Synthesize toolkit; Curves Offset To Revit Compatibility
string_from_object = FromObject(obj=curves_offset_to_revit.VARCurves)
code_block_3 = CodeBlock { "Line"; }
contains = String.Contains(string=string_from_object, searchFor=code_block_3)
filterByBoolMask_2 = List.FilterByBoolMask(list=curves_offset_to_revit.VARCurves, mask=contains)
python_empty_2_null = Custom[Python Empty 2 Null](VARIN=filterByBoolMask_2.out)  # package Synthesize toolkit; Python Null 2 Empty
VARSegmentationDistance = Input(VARSegmentationDistance: var[]..[])
lines_segmentation_by_distance = Custom[Lines Segmentation By Distance](VARCurves=python_empty_2_null, VARSegmentationDistance=VARSegmentationDistance, lacing=Longest)  # package Synthesize toolkit; Lines Segmentation By Distance
mergeByBoolMask = Custom[SP.List.MergeByBoolMask](VARIn=filterByBoolMask_2.in@L2, VAROut=lines_segmentation_by_distance@L2, VARmask=contains@L2)  # package Synthesize toolkit; Merge two lists by a boolean mask list. The true count in the mask should be the same as the length of the true list and vice versa for the false list.
as_polycurve_bycurves_2 = Custom[AS.[&] PolyCurve.ByCurves](VARcurves=mergeByBoolMask)
flatten_4 = List.Flatten(list=as_polycurve_bycurves_2.VARpolyCurve)
curves_2 = PolyCurve.Curves(polyCurve=flatten_4)
VAROffset = Input(VAROffset: var[]..[])
curves_offset_to_revit_2 = Custom[Curves Offset To Revit Compatibility](VARCurves=curves_2, VAROffset=VAROffset)
as_polycurve_bycurves_3 = Custom[AS.[&] PolyCurve.ByCurves](VARcurves=curves_offset_to_revit_2.VARCurves)
byPatch_2 = Surface.ByPatch(closedCurve=as_polycurve_bycurves_3.VARpolyCurve)
flatten_5 = List.Flatten(list=byPatch_2)
code_block_4 = CodeBlock { true; }
dynamo_geometry_to_revit = Custom[Dynamo Geometry To Revit Compatibility](VARGeometryOrSat=flatten_5, VARPreferImportInstance=code_block_4)  # package Synthesize toolkit; Dynamo Geometry To Revit Compatibility
VARImportInstance = Output(dynamo_geometry_to_revit)
