# Dynamo custom node Synthesize Report a Problem.dyf (Dynamo 2.1.0.7500)
# category: Synthesize.Report
# Synthesize Report a Problem

VARReport = Input(VARReport: var[]..[])
message = StringInput("""Please send the project to karam@aecedx.com 
Along with a small description of the problem""")  # graph input
code_block = CodeBlock { null; }
scopeIf = Custom[CW.ScopeIf+](VARtest=VARReport, VARtrue=message, VARfalse=code_block)  # A (hopefully) more robust implementation of ScopeIf. Tests a single boolean and returns a value accordingly.
alert_popup = Custom[Alert Popup](VARMessage=scopeIf)  # Popup a message dialog in Revit
VAROutput = Output(alert_popup)
