# Dynamo custom node Topography Auto K-Align Data Prepare.dyf (Dynamo 2.1.0.7500)
# category: Synthesize.Automate.Topography
# Topography Auto K-Align Data Prepare

VAREdges = Input(VAREdges: var[]..[])
flatten = List.Flatten(list=VAREdges)
length = Curve.Length(curve=flatten)
VARSpacingBetweenPointsToAdd = Input(VARSpacingBetweenPointsToAdd: var[]..[])
div = length / VARSpacingBetweenPointsToAdd
round = Math.Round(number=div)
range = Range(end=round, lacing=Longest)
code_block = CodeBlock { 0; 1; }
remapRange = Math.RemapRange(numbers=range, newMin=code_block.out0, newMax=code_block.out1)
pointAtParameter = Curve.PointAtParameter(curve=flatten, param=remapRange)
flatten_2 = List.Flatten(list=pointAtParameter)
XYZ = Custom[LF.Point.XYZ](VARpoint=flatten_2)  # Get the X, Y, and Z components of a Point
VARHeightOffsetOfSelectedEdges = Input(VARHeightOffsetOfSelectedEdges: var[]..[])
add = XYZ.VARZ + VARHeightOffsetOfSelectedEdges
byCoordinates = Point.ByCoordinates(x=XYZ.VARX, y=XYZ.VARY, z=add)
code_block_2 = CodeBlock { false; }
pruneDuplicates = Custom[SP.Points.PruneDuplicates+](VARpoints=byCoordinates, VARkeepDuplicateZ=code_block_2)  # An alternative to the built in node, that performs faster at the price of loosing the order of the points. All floating point valies are rounded to the nearest 4 decimal points. You can optionally remove duplicate Z values by setting "keepDuplicateZ" to false.
X = Point.X(point=pruneDuplicates)
VARNearbyPointsCleaningRange = Input(VARNearbyPointsCleaningRange: var[]..[])
add_2 = X + VARNearbyPointsCleaningRange
Y = Point.Y(point=pruneDuplicates)
add_3 = Y + VARNearbyPointsCleaningRange
VARTopography = Input(VARTopography: Revit.Elements.Element)
boundingBox = Element.BoundingBox(element=VARTopography)
maxPoint = BoundingBox.MaxPoint(boundingBox=boundingBox)
Z = Point.Z(point=maxPoint)
byCoordinates_2 = Point.ByCoordinates(x=add_2, y=add_3, z=Z)
VARMinPoints = Output(byCoordinates_2)
sub = X - VARNearbyPointsCleaningRange
sub_2 = Y - VARNearbyPointsCleaningRange
minPoint = BoundingBox.MinPoint(boundingBox=boundingBox)
Z_2 = Point.Z(point=minPoint)
byCoordinates_3 = Point.ByCoordinates(x=sub, y=sub_2, z=Z_2)
VARMaxPoints = Output(byCoordinates_3)
VARPointsToAdd = Output(pruneDuplicates)
