# Dynamo custom node Topography Lines of Intersects.dyf (Dynamo 2.1.0.7500)
# category: Synthesize.Automate.Topography
# Topography Lines of Intersects

VARElements = Input(VARElements: var[]..[])
element_geometry_fixer = Custom[Element.Geometry Fixer](VARElement=VARElements)  # Element.Geometry Fixer
flatten = List.Flatten(list=element_geometry_fixer)
explode = Geometry.Explode(geometry=flatten)
flatten_2 = List.Flatten(list=explode)
VARTopography = Input(VARTopography: var[]..[])
code_block = CodeBlock { "Topography"; }
byClassName = Custom[SP.Filter.ByClassName](VARobject=VARTopography, VARclassName=code_block)  # Filters a list of objects by the object's class name. Note that Dynamo elements belong to different classes than their Revit counterparts. Use the Object.Class node to check an object's class.
polySurface = Custom[ZK.Topography.PolySurface](VARTopography=byClassName.VARin)  # Convert topography element to polysurface
intersect = Geometry.Intersect(geometry=flatten_2, other=polySurface.VARPolySurface)
flatten_3 = List.Flatten(list=intersect)
as_polycurve_bycurves = Custom[AS.[&] PolyCurve.ByCurves](VARcurves=flatten_3)  # Create polycurves from an unordered list of curves.
code_block_2 = CodeBlock { false; }
clean = List.Clean(list=as_polycurve_bycurves.VARpolyCurve, preserveIndices=code_block_2)
curves = PolyCurve.Curves(polyCurve=clean)
code_block_3 = CodeBlock { 0..1..0.1; }
count = List.Count(list=curves@L2)
ofRepeatedItem = List.OfRepeatedItem(item=code_block_3, amount=count)
pointAtParameter = Curve.PointAtParameter(curve=curves@L2, param=ofRepeatedItem, lacing=Longest)
code_block_4 = CodeBlock { 3; }
byPoints = NurbsCurve.ByPoints(degree=code_block_4)  # unwired: points
map = List.Map(list=pointAtParameter, f_x=byPoints)
flatten_4 = List.Flatten(list=map)
byCurve = ModelCurve.ByCurve(curve=flatten_4)
VARModelCurve = Output(byCurve)
