# Dynamo custom node Topography Scale Points.dyf (Dynamo 2.1.0.7500)
# category: Synthesize.Automate.Lines
# Generate Scaled Lines

VARTopographyPoints = Input(VARTopographyPoints: var[]..[])
VARNewX = Input(VARNewX: var[]..[])
VAROldX = Input(VAROldX: var[]..[])
div = VARNewX / VAROldX
VARNewY = Input(VARNewY: var[]..[])
VAROldY = Input(VAROldY: var[]..[])
div_2 = VARNewY / VAROldY
VARNewZ = Input(VARNewZ: var[]..[])
VAROldZ = Input(VAROldZ: var[]..[])
div_3 = VARNewZ / VAROldZ
scale = Geometry.Scale(geometry=VARTopographyPoints, xamount=div, yamount=div_2, zamount=div_3)
flatten = List.Flatten(list=scale)
byPoints = Topography.ByPoints(points=flatten)
