# Dynamo custom node Topography Stepped Surfaces to Pads.dyf (Dynamo 2.1.0.7500)
# category: Synthesize.Automate.Topography
# Topography Stepped Surfaces to Pads

VARSetOffsetParameter = Input(VARSetOffsetParameter: var[]..[])
VARRounding = Input(VARRounding: var[]..[])
VARRoundingFix = Input(VARRoundingFix: var[]..[])
VARFixFactorDependsofProjectUnits1Formet = Input(VARFixFactorDependsofProjectUnits1Formetersforexampleand100forCentimeters: var[]..[])
VARUseAllLevelsIgnoresLevelsSelectionFil = Input(VARUseAllLevelsIgnoresLevelsSelectionFilter: var[]..[])
element_types = ElementTypes("Level")
all_elements_of_type = ElementsOfType(element_type=element_types)
hot_get_all_filter = Custom[HOT.Get All Filter]()  # Get all Filter
VARLevelsSelectionFiltertoRead = Input(VARLevelsSelectionFiltertoRead: var[]..[])
eq = hot_get_all_filter.VARName == VARLevelsSelectionFiltertoRead
filterByBoolMask = List.FilterByBoolMask(list=hot_get_all_filter.VARElement, mask=eq)
elements = Custom[CW.SelectionSet.Elements](VARselectionSet=filterByBoolMask.in)  # Retrieves all elements stored in a selection set
flatten = List.Flatten(list=elements)
scopeIf = Custom[CW.ScopeIf+](VARtest=VARUseAllLevelsIgnoresLevelsSelectionFil, VARtrue=all_elements_of_type, VARfalse=flatten)  # A (hopefully) more robust implementation of ScopeIf. Tests a single boolean and returns a value accordingly.
flatten_2 = List.Flatten(list=scopeIf)
VARSurfaces = Input(VARSurfaces: var[]..[])
perimeterCurves = Surface.PerimeterCurves(surface=VARSurfaces)
code_block = CodeBlock { false; }
clean = List.Clean(list=perimeterCurves, preserveIndices=code_block)
as_polycurve_bycurves = Custom[AS.[&] PolyCurve.ByCurves](VARcurves=clean@L2)  # Create polycurves from an unordered list of curves.
firstItem = List.FirstItem(list=as_polycurve_bycurves.VARpolyCurve@L2)
startPoint = Curve.StartPoint(curve=firstItem)
code_block_2 = CodeBlock { 0; }
detect_levels_of_points = Custom[Detect Levels of Points](VARSetOffsetParameter=VARSetOffsetParameter, VARRoundingValue=VARRounding, VARRoundingFix=VARRoundingFix, VARFixFactorDependsofProjectUnits1Formetersforexampleand100forCentimeters=VARFixFactorDependsofProjectUnits1Formet, VARLevels=flatten_2, VARPoints=startPoint, VARZLocationOffset=code_block_2)  # Family Refine Levels and Offset
element_types_2 = ElementTypes("BuildingPadType")
all_elements_of_type_2 = ElementsOfType(element_type=element_types_2)
isEmpty = List.IsEmpty(list=all_elements_of_type_2)
python_script = Python(IN[0]=isEmpty)
# ---------- python_script.python (43 lines) ----------
import clr
#Import Revit Services
clr.AddReference ("RevitServices")
import RevitServices
from RevitServices.Persistence import DocumentManager
from RevitServices.Transactions import TransactionManager
#Import Revit API
clr.AddReference('RevitAPI')
from Autodesk.Revit.DB import *
from Autodesk.Revit.DB.Architecture import *
clr.AddReference('RevitAPIUI')
from Autodesk.Revit.UI import *
#Import Revit Node
clr.AddReference('RevitNodes')
import Revit
clr.ImportExtensions(Revit.GeometryConversion)
clr.ImportExtensions(Revit.Elements)
#Import Proto Geometry
clr.AddReference('ProtoGeometry')
from Autodesk.DesignScript.Geometry import *

import System
from System.Collections.Generic import *

test = IN[0]

#get the document
doc = DocumentManager.Instance.CurrentDBDocument

#use safe transaction with Revit

if test == 1 :
	TransactionManager.Instance.EnsureInTransaction(doc)
	try :
		defaultpad = BuildingPadType.CreateDefault(doc)
	except :
		defaultpad = None
else :
	defaultpad = None
#Finish transaction with task done
TransactionManager.Instance.TransactionTaskDone()

OUT = defaultpad
# ----------------------------------------
code_block_3 = CodeBlock { "Type Name"; }
getParameterValueByName = Element.GetParameterValueByName(element=all_elements_of_type_2, parameterName=code_block_3)
VARPadTypeNametoUse = Input(VARPadTypeNametoUse: var[]..[])
eq_2 = getParameterValueByName == VARPadTypeNametoUse
filterByBoolMask_2 = List.FilterByBoolMask(list=all_elements_of_type_2, mask=eq_2)
create = List.Create(item0=python_script, item1=filterByBoolMask_2.in)
code_block_4 = CodeBlock { false; }
clean_2 = List.Clean(list=create, preserveIndices=code_block_4)
flatten_3 = List.Flatten(list=clean_2)
firstItem_2 = List.FirstItem(list=flatten_3)
curves = PolyCurve.Curves(polyCurve=as_polycurve_bycurves.VARpolyCurve)
toNurbsCurve = Curve.ToNurbsCurve(curve=curves)
flatten_4 = List.Flatten(list=toNurbsCurve@L3)
controlPoints = NurbsCurve.ControlPoints(nurbsCurve=flatten_4)
code_block_5 = CodeBlock { 3; }
byControlPoints = NurbsCurve.ByControlPoints(points=controlPoints, degree=code_block_5)
flatten_5 = List.Flatten(list=byControlPoints@L2)
al_group_curves = Custom[AL.Group Curves](VARCurves=flatten_5@L2)  # This node will take any input of flat list of curves and group them into sublists containing "joinable" curves that is continous curves. They might form closed curves or open curves. Use PolyCurve.ByJoinedCurves to convert output groups of curves into single PolyCurves
byJoinedCurves = PolyCurve.ByJoinedCurves(curves=al_group_curves@L3)
byPatch = Surface.ByPatch(closedCurve=byJoinedCurves)
area = Surface.Area(surface=byPatch)
maximumItem = List.MaximumItem(list=area)
eq_3 = area == maximumItem
filterByBoolMask_3 = List.FilterByBoolMask(list=byJoinedCurves, mask=eq_3)
curves_2 = PolyCurve.Curves(polyCurve=filterByBoolMask_3.in)
flatten_6 = List.Flatten(list=curves_2@L3)
simplify = Custom[SP.CurveLoop.Simplify](VARcurveLoop=flatten_6@L2)  # Attempts to simplify an open or a closed curve loop by connecting straight separate line segments into a single line.
create_pads_by_level_and_curves = Custom[Create Pads By Level and Curves Loops](VARLevels=detect_levels_of_points.VARLevelsSet, VARPadType=firstItem_2, VARCurves=simplify@L2, lacing=Longest)  # Create Pads By Level and Curves Loops
isNull = Object.IsNull(obj=create_pads_by_level_and_curves)
filterByBoolMask_4 = List.FilterByBoolMask(list=create_pads_by_level_and_curves, mask=isNull)
code_block_6 = CodeBlock { "Height Offset From Level"; }
filterByBoolMask_5 = List.FilterByBoolMask(list=detect_levels_of_points.VARElevationsSet, mask=isNull)
setParameterByName = Element.SetParameterByName(element=filterByBoolMask_4.out, parameterName=code_block_6, value=filterByBoolMask_5.out)
VARPads = Output(create_pads_by_level_and_curves)
VARPadType = Output(firstItem_2)
