# Dynamo custom node Transform Lines and Reference Points Onto Level Origin.dyf (Dynamo 2.1.0.7500)
# category: Synthesize.Automate.Lines
# Transform Lines and Reference Points Onto Level Origin

VARElements = Input(VARElements: var[]..[])
code_block = CodeBlock { "ReferencePoint"; }
byClassName = Custom[SP.Filter.ByClassName](VARobject=VARElements, VARclassName=code_block)  # Filters a list of objects by the object's class name. Note that Dynamo elements belong to different classes than their Revit counterparts. Use the Object.Class node to check an object's class.
curves = Element.Curves(element=byClassName.VARout)
flatten = List.Flatten(list=curves)
code_block_2 = CodeBlock { 6; 0; 1; }
sequence = Sequence(amount=code_block_2.out0, lacing=Longest)
remapRange = Math.RemapRange(numbers=sequence)
pointAtParameter = Curve.PointAtParameter(curve=flatten@L1, param=remapRange)
flatten_2 = List.Flatten(list=pointAtParameter)
pruneDuplicates = Custom[SP.Points.PruneDuplicates+](VARpoints=flatten_2)  # An alternative to the built in node, that performs faster at the price of loosing the order of the points. All floating point valies are rounded to the nearest 4 decimal points. You can optionally remove duplicate Z values by setting "keepDuplicateZ" to false.
byBestFitThroughPoints = Plane.ByBestFitThroughPoints(points=pruneDuplicates)
byPlane = CoordinateSystem.ByPlane(plane=byBestFitThroughPoints)
VARlevel = Input(VARlevel: var[]..[])
plane = Custom[CW.Level.Plane](VARlevel=VARlevel)  # Retrieves the plane of a given level
byPlane_2 = CoordinateSystem.ByPlane(plane=plane)
VARdegrees = Input(VARdegrees: var[]..[])
rotate = CoordinateSystem.Rotate(coordinateSystem=byPlane_2, plane=plane, degrees=VARdegrees)
transform = Geometry.Transform(geometry=flatten, fromCoordinateSystem=byPlane, contextCoordinateSystem=rotate)
VARCurves = Output(transform)
point = ReferencePoint.Point(referencePoint=byClassName.VARin)
transform_2 = Geometry.Transform(geometry=point, fromCoordinateSystem=byPlane, contextCoordinateSystem=rotate)
VARPoints = Output(transform_2)
