# Dynamo custom node Translate BuiltIn Parameter Group.dyf (Dynamo 2.1.0.7500)
# category: Synthesize.Fixers
# Translate BuiltIn Parameter Group

VARBuiltInParameterGroupString = Input(VARBuiltInParameterGroupString: var[]..[])
python_script = Python(IN[0]=VARBuiltInParameterGroupString)
# ---------- python_script.python (246 lines) ----------
import clr
clr.AddReference('ProtoGeometry')
from Autodesk.DesignScript.Geometry import *

# Enable Revit API
clr.AddReference('RevitAPI')
from Autodesk.Revit.DB import *

enum = IN[0]

if enum == "PG_ROUTE_ANALYSIS":
	pgtype = BuiltInParameterGroup.PG_ROUTE_ANALYSIS
elif enum == "PG_GEO_LOCATION":
	pgtype = BuiltInParameterGroup.PG_GEO_LOCATION
elif enum == "PG_STRUCTURAL_SECTION_GEOMETRY":
	pgtype = BuiltInParameterGroup.PG_STRUCTURAL_SECTION_GEOMETRY
elif enum == "PG_ENERGY_ANALYSIS_BLDG_CONS_MTL_THERMAL_PROPS":
	pgtype = BuiltInParameterGroup.PG_ENERGY_ANALYSIS_BLDG_CONS_MTL_THERMAL_PROPS
elif enum == "PG_ENERGY_ANALYSIS_ROOM_SPACE_DATA":
	pgtype = BuiltInParameterGroup.PG_ENERGY_ANALYSIS_ROOM_SPACE_DATA
elif enum == "PG_ENERGY_ANALYSIS_BUILDING_DATA":
	pgtype = BuiltInParameterGroup.PG_ENERGY_ANALYSIS_BUILDING_DATA
elif enum == "PG_COUPLER_ARRAY":
	pgtype = BuiltInParameterGroup.PG_COUPLER_ARRAY
elif enum == "PG_ENERGY_ANALYSIS_ADVANCED":
	pgtype = BuiltInParameterGroup.PG_ENERGY_ANALYSIS_ADVANCED
elif enum == "PG_RELEASES_MEMBER_FORCES":
	pgtype = BuiltInParameterGroup.PG_RELEASES_MEMBER_FORCES
elif enum == "PG_SECONDARY_END":
	pgtype = BuiltInParameterGroup.PG_SECONDARY_END
elif enum == "PG_PRIMARY_END":
	pgtype = BuiltInParameterGroup.PG_PRIMARY_END
elif enum == "PG_MOMENTS":
	pgtype = BuiltInParameterGroup.PG_MOMENTS
elif enum == "PG_FORCES":
	pgtype = BuiltInParameterGroup.PG_FORCES
elif enum == "PG_FABRICATION_PRODUCT_DATA":
	pgtype = BuiltInParameterGroup.PG_FABRICATION_PRODUCT_DATA
elif enum == "PG_REFERENCE":
	pgtype = BuiltInParameterGroup.PG_REFERENCE
elif enum == "PG_GEOMETRY_POSITIONING":
	pgtype = BuiltInParameterGroup.PG_GEOMETRY_POSITIONING
elif enum == "PG_DIVISION_GEOMETRY":
	pgtype = BuiltInParameterGroup.PG_DIVISION_GEOMETRY
elif enum == "PG_SEGMENTS_FITTINGS":
	pgtype = BuiltInParameterGroup.PG_SEGMENTS_FITTINGS
elif enum == "PG_CONTINUOUSRAIL_END_TOP_EXTENSION":
	pgtype = BuiltInParameterGroup.PG_CONTINUOUSRAIL_END_TOP_EXTENSION
elif enum == "PG_CONTINUOUSRAIL_BEGIN_BOTTOM_EXTENSION":
	pgtype = BuiltInParameterGroup.PG_CONTINUOUSRAIL_BEGIN_BOTTOM_EXTENSION
elif enum == "PG_STAIRS_WINDERS":
	pgtype = BuiltInParameterGroup.PG_STAIRS_WINDERS
elif enum == "PG_STAIRS_SUPPORTS":
	pgtype = BuiltInParameterGroup.PG_STAIRS_SUPPORTS
elif enum == "PG_STAIRS_OPEN_END_CONNECTION":
	pgtype = BuiltInParameterGroup.PG_STAIRS_OPEN_END_CONNECTION
elif enum == "PG_RAILING_SYSTEM_SECONDARY_FAMILY_HANDRAILS":
	pgtype = BuiltInParameterGroup.PG_RAILING_SYSTEM_SECONDARY_FAMILY_HANDRAILS
elif enum == "PG_TERMINTATION":
	pgtype = BuiltInParameterGroup.PG_TERMINTATION
elif enum == "PG_STAIRS_TREADS_RISERS":
	pgtype = BuiltInParameterGroup.PG_STAIRS_TREADS_RISERS
elif enum == "PG_STAIRS_CALCULATOR_RULES":
	pgtype = BuiltInParameterGroup.PG_STAIRS_CALCULATOR_RULES
elif enum == "PG_SPLIT_PROFILE_DIMENSIONS":
	pgtype = BuiltInParameterGroup.PG_SPLIT_PROFILE_DIMENSIONS
elif enum == "PG_LENGTH":
	pgtype = BuiltInParameterGroup.PG_LENGTH
elif enum == "PG_NODES":
	pgtype = BuiltInParameterGroup.PG_NODES
elif enum == "PG_ANALYTICAL_PROPERTIES":
	pgtype = BuiltInParameterGroup.PG_ANALYTICAL_PROPERTIES
elif enum == "PG_ANALYTICAL_ALIGNMENT":
	pgtype = BuiltInParameterGroup.PG_ANALYTICAL_ALIGNMENT
elif enum == "PG_SYSTEMTYPE_RISEDROP":
	pgtype = BuiltInParameterGroup.PG_SYSTEMTYPE_RISEDROP
elif enum == "PG_LINING":
	pgtype = BuiltInParameterGroup.PG_LINING
elif enum == "PG_INSULATION":
	pgtype = BuiltInParameterGroup.PG_INSULATION
elif enum == "PG_OVERALL_LEGEND":
	pgtype = BuiltInParameterGroup.PG_OVERALL_LEGEND
elif enum == "PG_VISIBILITY":
	pgtype = BuiltInParameterGroup.PG_VISIBILITY
elif enum == "PG_SUPPORT":
	pgtype = BuiltInParameterGroup.PG_SUPPORT
elif enum == "PG_RAILING_SYSTEM_SEGMENT_V_GRID":
	pgtype = BuiltInParameterGroup.PG_RAILING_SYSTEM_SEGMENT_V_GRID
elif enum == "PG_RAILING_SYSTEM_SEGMENT_U_GRID":
	pgtype = BuiltInParameterGroup.PG_RAILING_SYSTEM_SEGMENT_U_GRID
elif enum == "PG_RAILING_SYSTEM_SEGMENT_POSTS":
	pgtype = BuiltInParameterGroup.PG_RAILING_SYSTEM_SEGMENT_POSTS
elif enum == "PG_RAILING_SYSTEM_SEGMENT_PATTERN_REMAINDER":
	pgtype = BuiltInParameterGroup.PG_RAILING_SYSTEM_SEGMENT_PATTERN_REMAINDER
elif enum == "PG_RAILING_SYSTEM_SEGMENT_PATTERN_REPEAT":
	pgtype = BuiltInParameterGroup.PG_RAILING_SYSTEM_SEGMENT_PATTERN_REPEAT
elif enum == "PG_RAILING_SYSTEM_FAMILY_SEGMENT_PATTERN":
	pgtype = BuiltInParameterGroup.PG_RAILING_SYSTEM_FAMILY_SEGMENT_PATTERN
elif enum == "PG_RAILING_SYSTEM_FAMILY_HANDRAILS":
	pgtype = BuiltInParameterGroup.PG_RAILING_SYSTEM_FAMILY_HANDRAILS
elif enum == "PG_RAILING_SYSTEM_FAMILY_TOP_RAIL":
	pgtype = BuiltInParameterGroup.PG_RAILING_SYSTEM_FAMILY_TOP_RAIL
elif enum == "PG_CONCEPTUAL_ENERGY_DATA_BUILDING_SERVICES":
	pgtype = BuiltInParameterGroup.PG_CONCEPTUAL_ENERGY_DATA_BUILDING_SERVICES
elif enum == "PG_DATA":
	pgtype = BuiltInParameterGroup.PG_DATA
elif enum == "PG_ELECTRICAL_CIRCUITING":
	pgtype = BuiltInParameterGroup.PG_ELECTRICAL_CIRCUITING
elif enum == "PG_GENERAL":
	pgtype = BuiltInParameterGroup.PG_GENERAL
elif enum == "PG_FLEXIBLE":
	pgtype = BuiltInParameterGroup.PG_FLEXIBLE
elif enum == "PG_ENERGY_ANALYSIS_CONCEPTUAL_MODEL":
	pgtype = BuiltInParameterGroup.PG_ENERGY_ANALYSIS_CONCEPTUAL_MODEL
elif enum == "PG_ENERGY_ANALYSIS_DETAILED_MODEL":
	pgtype = BuiltInParameterGroup.PG_ENERGY_ANALYSIS_DETAILED_MODEL
elif enum == "PG_ENERGY_ANALYSIS_DETAILED_AND_CONCEPTUAL_MODELS":
	pgtype = BuiltInParameterGroup.PG_ENERGY_ANALYSIS_DETAILED_AND_CONCEPTUAL_MODELS
elif enum == "PG_FITTING":
	pgtype = BuiltInParameterGroup.PG_FITTING
elif enum == "PG_CONCEPTUAL_ENERGY_DATA":
	pgtype = BuiltInParameterGroup.PG_CONCEPTUAL_ENERGY_DATA
elif enum == "PG_AREA":
	pgtype = BuiltInParameterGroup.PG_AREA
elif enum == "PG_ADSK_MODEL_PROPERTIES":
	pgtype = BuiltInParameterGroup.PG_ADSK_MODEL_PROPERTIES
elif enum == "PG_CURTAIN_GRID_V":
	pgtype = BuiltInParameterGroup.PG_CURTAIN_GRID_V
elif enum == "PG_CURTAIN_GRID_U":
	pgtype = BuiltInParameterGroup.PG_CURTAIN_GRID_U
elif enum == "PG_DISPLAY":
	pgtype = BuiltInParameterGroup.PG_DISPLAY
elif enum == "PG_ANALYSIS_RESULTS":
	pgtype = BuiltInParameterGroup.PG_ANALYSIS_RESULTS
elif enum == "PG_SLAB_SHAPE_EDIT":
	pgtype = BuiltInParameterGroup.PG_SLAB_SHAPE_EDIT
elif enum == "PG_LIGHT_PHOTOMETRICS":
	pgtype = BuiltInParameterGroup.PG_LIGHT_PHOTOMETRICS
elif enum == "PG_PATTERN_APPLICATION":
	pgtype = BuiltInParameterGroup.PG_PATTERN_APPLICATION
elif enum == "PG_GREEN_BUILDING":
	pgtype = BuiltInParameterGroup.PG_GREEN_BUILDING
elif enum == "PG_PROFILE_2":
	pgtype = BuiltInParameterGroup.PG_PROFILE_2
elif enum == "PG_PROFILE_1":
	pgtype = BuiltInParameterGroup.PG_PROFILE_1
elif enum == "PG_PROFILE":
	pgtype = BuiltInParameterGroup.PG_PROFILE
elif enum == "PG_TRUSS_FAMILY_BOTTOM_CHORD":	
	pgtype = BuiltInParameterGroup.PG_TRUSS_FAMILY_BOTTOM_CHORD
elif enum == "PG_TRUSS_FAMILY_TOP_CHORD":
	pgtype = BuiltInParameterGroup.PG_TRUSS_FAMILY_TOP_CHORD
elif enum == "PG_TRUSS_FAMILY_DIAG_WEB":
	pgtype = BuiltInParameterGroup.PG_TRUSS_FAMILY_DIAG_WEB
elif enum == "PG_TRUSS_FAMILY_VERT_WEB":
	pgtype = BuiltInParameterGroup.PG_TRUSS_FAMILY_VERT_WEB
elif enum == "PG_TITLE":
	pgtype = BuiltInParameterGroup.PG_TITLE
elif enum == "PG_FIRE_PROTECTION":
	pgtype = BuiltInParameterGroup.PG_FIRE_PROTECTION
elif enum == "PG_ROTATION_ABOUT":
	pgtype = BuiltInParameterGroup.PG_ROTATION_ABOUT
elif enum == "PG_TRANSLATION_IN":
	pgtype = BuiltInParameterGroup.PG_TRANSLATION_IN
elif enum == "PG_ANALYTICAL_MODEL":
	pgtype = BuiltInParameterGroup.PG_ANALYTICAL_MODEL
elif enum == "PG_REBAR_ARRAY":
	pgtype = BuiltInParameterGroup.PG_REBAR_ARRAY
elif enum == "PG_REBAR_SYSTEM_LAYERS":
	pgtype = BuiltInParameterGroup.PG_REBAR_SYSTEM_LAYERS
elif enum == "PG_CURTAIN_GRID":
	pgtype = BuiltInParameterGroup.PG_CURTAIN_GRID
elif enum == "PG_CURTAIN_MULLION_2":
	pgtype = BuiltInParameterGroup.PG_CURTAIN_MULLION_2
elif enum == "PG_CURTAIN_MULLION_HORIZ":
	pgtype = BuiltInParameterGroup.PG_CURTAIN_MULLION_HORIZ
elif enum == "PG_CURTAIN_MULLION_1":
	pgtype = BuiltInParameterGroup.PG_CURTAIN_MULLION_1
elif enum == "PG_CURTAIN_MULLION_VERT":
	pgtype = BuiltInParameterGroup.PG_CURTAIN_MULLION_VERT
elif enum == "PG_CURTAIN_GRID_2":
	pgtype = BuiltInParameterGroup.PG_CURTAIN_GRID_2
elif enum == "PG_CURTAIN_GRID_HORIZ":
	pgtype = BuiltInParameterGroup.PG_CURTAIN_GRID_HORIZ
elif enum == "PG_CURTAIN_GRID_1":
	pgtype = BuiltInParameterGroup.PG_CURTAIN_GRID_1
elif enum == "PG_CURTAIN_GRID_VERT":
	pgtype = BuiltInParameterGroup.PG_CURTAIN_GRID_VERT
elif enum == "PG_IFC":
	pgtype = BuiltInParameterGroup.PG_IFC
elif enum == "PG_AELECTRICAL":
	pgtype = BuiltInParameterGroup.PG_AELECTRICAL
elif enum == "PG_ENERGY_ANALYSIS":
	pgtype = BuiltInParameterGroup.PG_ENERGY_ANALYSIS
elif enum == "PG_STRUCTURAL_ANALYSIS":
	pgtype = BuiltInParameterGroup.PG_STRUCTURAL_ANALYSIS
elif enum == "PG_MECHANICAL_AIRFLOW":
	pgtype = BuiltInParameterGroup.PG_MECHANICAL_AIRFLOW
elif enum == "PG_MECHANICAL_LOADS":
	pgtype = BuiltInParameterGroup.PG_MECHANICAL_LOADS
elif enum == "PG_ELECTRICAL_LOADS":
	pgtype = BuiltInParameterGroup.PG_ELECTRICAL_LOADS
elif enum == "PG_ELECTRICAL_LIGHTING":
	pgtype = BuiltInParameterGroup.PG_ELECTRICAL_LIGHTING
elif enum == "PG_TEXT":
	pgtype = BuiltInParameterGroup.PG_TEXT
elif enum == "PG_VIEW_CAMERA":
	pgtype = BuiltInParameterGroup.PG_VIEW_CAMERA
elif enum == "PG_VIEW_EXTENTS":
	pgtype = BuiltInParameterGroup.PG_VIEW_EXTENTS
elif enum == "PG_PATTERN":
	pgtype = BuiltInParameterGroup.PG_PATTERN
elif enum == "PG_CONSTRAINTS":
	pgtype = BuiltInParameterGroup.PG_CONSTRAINTS
elif enum == "PG_PHASING":
	pgtype = BuiltInParameterGroup.PG_PHASING
elif enum == "PG_MECHANICAL":
	pgtype = BuiltInParameterGroup.PG_MECHANICAL
elif enum == "PG_STRUCTURAL":	
	pgtype = BuiltInParameterGroup.PG_STRUCTURAL
elif enum == "PG_PLUMBING":
	pgtype = BuiltInParameterGroup.PG_PLUMBING
elif enum == "PG_ELECTRICAL":
	pgtype = BuiltInParameterGroup.PG_ELECTRICAL
elif enum == "PG_STAIR_STRINGERS":
	pgtype = BuiltInParameterGroup.PG_STAIR_STRINGERS
elif enum == "PG_STAIR_RISERS":
	pgtype = BuiltInParameterGroup.PG_STAIR_RISERS
elif enum == "PG_STAIR_TREADS":
	pgtype = BuiltInParameterGroup.PG_STAIR_TREADS
elif enum == "PG_UNDERLAY":
	pgtype = BuiltInParameterGroup.PG_UNDERLAY
elif enum == "PG_MATERIALS":
	pgtype = BuiltInParameterGroup.PG_MATERIALS
elif enum == "PG_GRAPHICS":
	pgtype = BuiltInParameterGroup.PG_GRAPHICS
elif enum == "PG_CONSTRUCTION":
	pgtype = BuiltInParameterGroup.PG_CONSTRUCTION
elif enum == "PG_GEOMETRY":
	pgtype = BuiltInParameterGroup.PG_GEOMETRY
elif enum == "PG_IDENTITY_DATA":
	pgtype = BuiltInParameterGroup.PG_IDENTITY_DATA
elif enum == "INVALID":
	pgtype = BuiltInParameterGroup.INVALID
	
OUT = pgtype
# ----------------------------------------
VARBuiltInParameterGroup = Output(python_script)
