# Dynamo custom node Try Union.dyf (Dynamo 2.1.0.7500)
# category: Synthesize.Automate.Geometry
# Try Union

VARGeometryList = Input(VARGeometryList: var[]..[])
VARUnionOrNot = Input(VARUnionOrNot: var[]..[])
python_script = Python(IN[0]=VARGeometryList, IN[1]=VARUnionOrNot)
# ---------- python_script.python (26 lines) ----------
# Enable Python support and load DesignScript library
# IMPORTANT : ALL DYNAMO DESIGN SCRIPT NODES ARE AS (dg)
import clr
clr.AddReference('ProtoGeometry')
from Autodesk.DesignScript import Geometry as dg

# Enable ICollection List Translate
clr.AddReference("System")
import System.Collections.Generic
from System.Collections.Generic import List

dataEnteringNode = IN
# Use UnwrapElement(IN[0]) When Translating From Dynamo to Revit
result=(IN[0])
forcejoin=IN[1]

if forcejoin == True:
	try:
		unioned = [dg.Solid.ByUnion(result)]
		for r in result:
			r.Dispose()
	except:
		unioned = result
	OUT = unioned
else:
	OUT = result
# ----------------------------------------
VARSolid = Output(python_script)
