# Dynamo custom node Try to Hide Elements In Mass Only.dyf (Dynamo 2.1.0.7500)
# category: Synthesize.Automate.Select
# Try to Hide Elements

VARElements = Input(VARElements: var[]..[])
VARWait = Input(VARWait: var[]..[])
python_script = Python(IN[0]=VARElements, IN[1]=VARWait)
# ---------- python_script.python (79 lines) ----------
# Enable Python support and load DesignScript library
# IMPORTANT : ALL DYNAMO DESIGN SCRIPT NODES ARE AS (dg)
import clr
clr.AddReference('ProtoGeometry')
from Autodesk.DesignScript import Geometry as dg

# EXTENSION Enable ToDSType
clr.AddReference('RevitNodes')
import Revit
clr.ImportExtensions(Revit.Elements)

# Enable Revit Elements
from Revit.Elements import *

# EXTENSION Enable Geometry Conversion Methods
clr.ImportExtensions(Revit.GeometryConversion)

# Enable Revit API
clr.AddReference('RevitAPI')
from Autodesk.Revit.DB import *

# Enable DocumentManager and TransactionManager
clr.AddReference('RevitServices')
from RevitServices.Persistence import DocumentManager
from RevitServices.Transactions import TransactionManager

# Enable ICollection List Translate
clr.AddReference("System")
import System.Collections.Generic
from System.Collections.Generic import List

clr.AddReference("RevitAPIUI")
from Autodesk.Revit.UI import TaskDialog

def tolist(obj1):
	if hasattr(obj1,'__iter__'): return obj1
	else: return [obj1]

def flatten(x):
    result = []
    for el in x:
        if hasattr(el, "__iter__") and not isinstance(el, basestring):
            result.extend(flatten(el))
        else:
            result.append(el)
    return result

dataEnteringNode = IN
# Use UnwrapElement(IN[0]) When Translating From Dynamo to Revit
lines=UnwrapElement(flatten(tolist(IN[0])))
wait=IN[1]
vistatus=False

# Choose The Current Document
doc = DocumentManager.Instance.CurrentDBDocument
uidoc = DocumentManager.Instance.CurrentUIApplication.ActiveUIDocument
uiapp = DocumentManager.Instance.CurrentUIApplication
app = uiapp.Application

TransactionManager.Instance.EnsureInTransaction(doc)

# Create Empty List
result = []
nosafe = []
if (doc.OwnerFamily.FamilyCategory).Name == "Mass":
	for each in lines:
		visparam = each.LookupParameter("Visible")
		safeline = False
		if visparam != None:
			safeline = True
			e.Set(vistatus)
		if safeline == True:
			result.append(each)
		if safeline == False:
			nosafe.append(each)
TransactionManager.Instance.TransactionTaskDone()

# Assign your output to the OUT variable.
OUT = result,nosafe
# ----------------------------------------
VAROutput = Output(python_script)
