# Dynamo custom node UV Management Emergancy Fix.dyf (Dynamo 2.1.0.7500)
# category: Synthesize.Automate.Surface
# UV Management Emergancy Fix

code_block = CodeBlock { 1; }
VARLoopMode = Input(VARLoopMode: var[]..[])
VARSorted = Input(VARSorted: var[]..[])
flatten = List.Flatten(list=VARSorted)
code_block_2 = CodeBlock { false; }
clean = List.Clean(list=flatten, preserveIndices=code_block_2)
VARGuides = Input(VARGuides: var[]..[])
flatten_2 = List.Flatten(list=VARGuides)
byLoft = Surface.ByLoft(crossSections=clean, guideCurves=flatten_2)
perimeterCurves = Surface.PerimeterCurves(surface=byLoft)
byPatch = Surface.ByPatch(closedCurve=perimeterCurves)
isNull = Object.IsNull(obj=byPatch)
filterByBoolMask = List.FilterByBoolMask(list=perimeterCurves, mask=isNull)
intersect = Geometry.Intersect(geometry=clean, other=filterByBoolMask.in@L1)
flatten_3 = List.Flatten(list=intersect)
UVParameterAtPoint = Surface.UVParameterAtPoint(surface=byLoft, point=flatten_3)
V = UV.V(uV=UVParameterAtPoint)
byIsoCurveOnSurface = Curve.ByIsoCurveOnSurface(baseSurface=byLoft, parameter=V)
code_block_3 = CodeBlock { 0.5; }
splitByParameter = Curve.SplitByParameter(curve=byIsoCurveOnSurface, parameters=code_block_3)
firstItem = List.FirstItem(list=splitByParameter@L2)
lastItem = List.LastItem(list=firstItem)
addItemToFront = List.AddItemToFront(item=lastItem, list=firstItem)
scopeIf = Custom[CW.ScopeIf+](VARtest=VARLoopMode, VARtrue=addItemToFront, VARfalse=firstItem)  # A (hopefully) more robust implementation of ScopeIf. Tests a single boolean and returns a value accordingly.
byLoft_2 = Surface.ByLoft(crossSections=scopeIf, guideCurves=flatten_2)
lastItem_2 = List.LastItem(list=splitByParameter@L2)
lastItem_3 = List.LastItem(list=lastItem_2)
addItemToFront_2 = List.AddItemToFront(item=lastItem_3, list=lastItem_2)
scopeIf_2 = Custom[CW.ScopeIf+](VARtest=VARLoopMode, VARtrue=addItemToFront_2, VARfalse=lastItem_2)
byLoft_3 = Surface.ByLoft(crossSections=scopeIf_2, guideCurves=flatten_2)
join = List.Join(list0=byLoft_2, list1=byLoft_3)
VARSurfaces = Output(join)
