# Dynamo custom node UV Management Loft.dyf (Dynamo 2.1.0.7500)
# category: Synthesize.Automate.Loft
# UV Management Loft

VAROffsetProfiles = Input(VAROffsetProfiles: double)
code_block = CodeBlock { 0; }
eq = VAROffsetProfiles == code_block
empty = List.Empty()
VARForceCloseProfiles = Input(VARForceCloseProfiles: bool)
VARPointsDistanceProfiles = Input(VARPointsDistanceProfiles: var)
VARProfiles = Input(VARProfiles: var[]..[])
flatten = List.Flatten(list=VARProfiles)
as_polycurve_bycurves = Custom[AS.[&] PolyCurve.ByCurves](VARcurves=flatten)  # Create polycurves from an unordered list of curves.
VARSmoothModeProfiles = Input(VARSmoothModeProfiles: var)
smooth_curves = Custom[Smooth Curves](VARForceClose=VARForceCloseProfiles, VARPointsDistance=VARPointsDistanceProfiles, VARCurves=as_polycurve_bycurves.VARpolyCurve, VARSmoothMode=VARSmoothModeProfiles)  # Smooth Curves
explode = Geometry.Explode(geometry=smooth_curves)
scopeIf = Custom[CW.ScopeIf+](VARtest=eq, VARtrue=empty, VARfalse=explode)  # A (hopefully) more robust implementation of ScopeIf. Tests a single boolean and returns a value accordingly.
curves_offset_to_revit = Custom[Curves Offset To Revit Compatibility](VARCurves=scopeIf, VAROffset=VAROffsetProfiles)  # frozen; Curves Offset To Revit Compatibility
code_block_2 = CodeBlock { 1; }
VARRevitImportReport = Output(code_block_2)
join = List.Join()  # unwired: list0, list1
VARImportToRevit = Input(VARImportToRevit: var)
VARDrawIntersects = Input(VARDrawIntersects: var)
code_block_3 = CodeBlock { false; }
scopeIf_2 = Custom[CW.ScopeIf+](VARtest=VARImportToRevit, VARtrue=VARDrawIntersects, VARfalse=code_block_3)
scopeIf_3 = Custom[CW.ScopeIf+](VARtest=scopeIf_2, VARtrue=VARDrawIntersects, VARfalse=code_block_3)
as_polycurve_bycurves_2 = Custom[AS.[&] PolyCurve.ByCurves](VARcurves=explode)
flatten_2 = List.Flatten(list=as_polycurve_bycurves_2.VARpolyCurve)
as_polycurve_bycurves_3 = Custom[AS.[&] PolyCurve.ByCurves](VARcurves=scopeIf)
flatten_3 = List.Flatten(list=as_polycurve_bycurves_3.VARpolyCurve)
create = List.Create(item0=flatten_2, item1=flatten_3)
code_block_4 = CodeBlock { false; }
clean = List.Clean(list=create, preserveIndices=code_block_4)
flatten_4 = List.Flatten(list=clean)
VARGuides = Input(VARGuides: var[]..[])
flatten_5 = List.Flatten(list=VARGuides)
as_polycurve_bycurves_4 = Custom[AS.[&] PolyCurve.ByCurves](VARcurves=flatten_5)
sort_geometry_by_guides = Custom[Sort Geometry By Guides](VARGeometries=flatten_4, VARGuides=as_polycurve_bycurves_4.VARpolyCurve)  # Sort Loft Profiles According to Guide
VAROffsetGuides = Input(VAROffsetGuides: double)
code_block_5 = CodeBlock { 0; }
eq_2 = VAROffsetGuides == code_block_5
VARForceCloseGuides = Input(VARForceCloseGuides: bool)
VARPointsDistanceGuides = Input(VARPointsDistanceGuides: var)
VARSmoothModeGuides = Input(VARSmoothModeGuides: var)
smooth_curves_2 = Custom[Smooth Curves](VARForceClose=VARForceCloseGuides, VARPointsDistance=VARPointsDistanceGuides, VARCurves=as_polycurve_bycurves_4.VARpolyCurve, VARSmoothMode=VARSmoothModeGuides)
explode_2 = Geometry.Explode(geometry=smooth_curves_2)
empty_2 = List.Empty()
scopeIf_4 = Custom[CW.ScopeIf+](VARtest=eq_2, VARtrue=empty_2, VARfalse=explode_2)
curves_offset_to_revit_2 = Custom[Curves Offset To Revit Compatibility](VARCurves=scopeIf_4, VAROffset=VAROffsetGuides)
scopeIf_5 = Custom[CW.ScopeIf+](VARtest=eq_2, VARtrue=explode_2, VARfalse=curves_offset_to_revit_2.VARCurves)
as_polycurve_bycurves_5 = Custom[AS.[&] PolyCurve.ByCurves](VARcurves=scopeIf_5)
flatten_6 = List.Flatten(list=as_polycurve_bycurves_5.VARpolyCurve)
VARLoopMode = Input(VARLoopMode: var)
VARGuidesasRails = Input(VARGuidesasRails: var)
python_script = Python(IN[0]=sort_geometry_by_guides.VARSortedGeometries, IN[1]=flatten_6, IN[2]=VARLoopMode, IN[3]=VARGuidesasRails)
# ---------- python_script.python (163 lines) ----------
# Created By : Karam Baki : karam@aecedx.com
# Enable Python support and load DesignScript library
# IMPORTANT : ALL DYNAMO DESIGN SCRIPT NODES ARE AS (dg)
import clr
clr.AddReference('ProtoGeometry')
from Autodesk.DesignScript import Geometry as dg

# EXTENSION Enable ToDSType
clr.AddReference('RevitNodes')
import Revit
clr.ImportExtensions(Revit.Elements)

# Enable Revit Elements
from Revit.Elements import *

# EXTENSION Enable Geometry Conversion Methods
clr.ImportExtensions(Revit.GeometryConversion)

# Enable Revit API
clr.AddReference('RevitAPI')
from Autodesk.Revit.DB import *

# Enable DocumentManager and TransactionManager
clr.AddReference('RevitServices')
from RevitServices.Persistence import DocumentManager
from RevitServices.Transactions import TransactionManager

# Enable ICollection List Translate
clr.AddReference("System")
import System.Collections.Generic
from System.Collections.Generic import List

dataEnteringNode = IN
# Use UnwrapElement(IN[0]) When Translating From Dynamo to Revit
profs=UnwrapElement(IN[0])
guides=UnwrapElement(IN[1])
loopmode=UnwrapElement(IN[2])
withguides=UnwrapElement(IN[3])

if loopmode == True:
	getsolid=False

newprofs = []
for each in profs:
	newprofs.append(each)

profs = newprofs
fail = []
if len(profs) == 1:
	if guides[0].IsClosed:
		result = dg.Curve.SweepAsSurface(profs[0],guides[0])
	else:
		try:
			result = dg.Curve.SweepAsSolid(profs[0],guides[0])
		except:
			result = dg.Curve.SweepAsSurface(profs[0],guides[0])
	
else:
	if loopmode == True:
		firstitem = profs[0]
		profs.append(firstitem)

	fail = False

	if withguides == True and loopmode == False:
		try:
			result = dg.Solid.ByLoft(profs,guides)
		except:
			try:
				result = dg.Surface.ByLoft(profs,guides)
			except:
				try:
					result = dg.Solid.ByLoft(profs)
				except:
					try:
						result = dg.Surface.ByLoft(profs)
					except:
						fail = True
	if withguides == False and loopmode == False:
		try:
			result = dg.Solid.ByLoft(profs)
		except:
			try:
				result = dg.Surface.ByLoft(profs)
			except:
				fail = True

	if withguides == True and loopmode == True:
		try:
			result = dg.Surface.ByLoft(profs,guides)
		except:
			try:
				result = dg.Surface.ByLoft(profs)
			except:
				fail = True

	if withguides == False and loopmode == True:
		try:
			result = dg.Surface.ByLoft(profs)
		except:
			fail = True

	if fail == True and loopmode == True:
		profs.pop(0)
		if withguides == True:
			try:
				result = dg.Solid.ByLoft(profs,guides)
			except:
				try:
					result = dg.Surface.ByLoft(profs,guides)
				except:
					try:
						result = dg.Solid.ByLoft(profs)
					except:
						result = dg.Surface.ByLoft(profs)
		else:
			try:
				result = dg.Solid.ByLoft(profs)
			except:
				result = dg.Surface.ByLoft(profs)

closedsurf = False
try:
	if isinstance(result,dg.Surface) and result.Closed:
		if len(dg.Geometry.Explode(result)) == 1:
			closedsurf = True
			try:
				iso = dg.Curve.ByIsoCurveOnSurface(result,0,0)
			except:
				iso = dg.Curve.ByIsoCurveOnSurface(result,0,0.5)
			split = list(dg.Geometry.Split(result,iso))
			#result.Dispose()
			result = dg.Solid.ByJoinedSurfaces([dg.PolySurface.ByJoinedSurfaces(split)])
			#for s in split:
			#	s.Dispose()
		else:
			try:	
				licked = []
				exploded = dg.Geometry.Explode(result)
				for e in exploded:
					iso1 = dg.Curve.ByIsoCurveOnSurface(e,0,0.5)
					split1 = list(dg.Geometry.Split(e,iso1))
					for s in split1:
						licked.append(s)
				result = dg.PolySurface.ByJoinedSurfaces(licked)
				try:
					result = dg.Solid.ByJoinedSurfaces([result])
				except:
					pass
			except:
				result = dg.Solid.ByJoinedSurfaces([dg.PolySurface.ByJoinedSurfaces([result])])
except:
	try:
		result = dg.Solid.ByJoinedSurfaces([result])
	except:
		pass

docmethod = True
if isinstance(result,dg.Solid) or closedsurf:
	docmethod = False

# Assign your output to the OUT variable.
OUT = result,docmethod
# ----------------------------------------
code_block_6 = CodeBlock(a=python_script) { a[0]; a[1]; }
code_block_7 = CodeBlock { false; }
clean_2 = List.Clean(list=code_block_6.out0, preserveIndices=code_block_7)
flatten_7 = List.Flatten(list=clean_2)
faces = Topology.Faces(topology=flatten_7)
flatten_8 = List.Flatten(list=faces)
surfaceGeometry = Face.SurfaceGeometry(face=flatten_8)
toNurbsSurface = Surface.ToNurbsSurface(surface=surfaceGeometry)
empty_3 = List.Empty()
scopeIf_6 = Custom[CW.ScopeIf+](VARtest=scopeIf_3, VARtrue=toNurbsSurface, VARfalse=empty_3)
VARU = Input(VARU: int)
VARV = Input(VARV: int)
cw_paneling_gridfromface_without = Custom[CW.Paneling.GridFromFace Without Flatten](VARsurface=scopeIf_6@L1, VARU=VARU, VARV=VARV)  # Returns UV coordinates, XYZ coordinates and normals for a face with UV subdivision
scopeIf_7 = Custom[CW.ScopeIf+](VARtest=scopeIf_3, VARtrue=cw_paneling_gridfromface_without.VARPoints, VARfalse=empty_3)
transpose = List.Transpose(lists=scopeIf_7@L3)
byPoints = PolyCurve.ByPoints(points=transpose)
dropFirstLast = Custom[SP.List.DropFirstLast](VARlist=byPoints@L2)  # Removes the first and last items from the list
byPoints_2 = PolyCurve.ByPoints(points=scopeIf_7)
dropFirstLast_2 = Custom[SP.List.DropFirstLast](VARlist=byPoints_2@L2)
combine = List.Combine(comb=join, list1=dropFirstLast.VARlist, list2=dropFirstLast_2.VARlist)
VARNumberofControlPointsPerLine = Input(VARNumberofControlPointsPerLine: var)
code_block_8 = CodeBlock { false; }
scopeIf_8 = Custom[CW.ScopeIf+](VARtest=VARImportToRevit, VARtrue=VARDrawIntersects, VARfalse=code_block_8)
VARExtraExtendedDistance = Input(VARExtraExtendedDistance: var)
VARReferencePlanesOffset = Input(VARReferencePlanesOffset: var)
VARReferencePlaneNamePrefix = Input(VARReferencePlaneNamePrefix: var)
VARFlipReferencePlanesSide = Input(VARFlipReferencePlanesSide: var)
generate_t_lines = Custom[Generate T-Lines](VARCurves=combine, VARUGrid=VARU, VARVGrid=VARV, VARNumberofControlPointsPerLine=VARNumberofControlPointsPerLine, VARDrawLines=scopeIf_8, VARExtraExtendedDistance=VARExtraExtendedDistance, VARLinesWithPoints=scopeIf_8, VARFaces=toNurbsSurface, VARReferencePlanesOffset=VARReferencePlanesOffset, VARReferencePlaneNamePrefix=VARReferencePlaneNamePrefix, VARFlipReferencePlanesSide=VARFlipReferencePlanesSide)  # Generate T-Lines
code_block_9 = CodeBlock { "Offset"; 0; "Is Reference Line"; 1; }
setParameterByName = Element.SetParameterByName(element=generate_t_lines.VARReferencePoints, parameterName=code_block_9.out0, value=code_block_9.out1)
VARReferencePoints = Output(setParameterByName)
setParameterByName_2 = Element.SetParameterByName(element=generate_t_lines.VARModelCurve, parameterName=code_block_9.out2, value=code_block_9.out3)
curves_offset_to_revit_3 = Custom[Curves Offset To Revit Compatibility](VARCurves=explode)  # frozen
VARPlaceInstaceEvenIfAlreadyPlaced = Input(VARPlaceInstaceEvenIfAlreadyPlaced: bool = false)
VARPositionSystemFalseIsInstanceOriginTr = Input(VARPositionSystemFalseIsInstanceOriginTrueIsRelativeToProjectOrigin: bool = true)
VARUpdateFamilyEvenIfAlreadyExists = Input(VARUpdateFamilyEvenIfAlreadyExists: var)
eraser = Custom[ST.Tool.Eraser](VARList=generate_t_lines.VARReferencePlanes)  # Try to delete any element from project
empty_4 = List.Empty()
scopeIf_9 = Custom[CW.ScopeIf+](VARtest=VARImportToRevit, VARtrue=flatten_7, VARfalse=empty_4)
VAROneFamily = Input(VAROneFamily: bool)
VARAutoSequenceNamingSuffix = Input(VARAutoSequenceNamingSuffix: var)
VARFamilyName = Input(VARFamilyName: var)
VARStartSequenceNamingSuffix = Input(VARStartSequenceNamingSuffix: var)
VARFamilyCategory = Input(VARFamilyCategory: var)
VARFamilyTemplate = Input(VARFamilyTemplate: var)
VARisShared = Input(VARisShared: var)
VARIsVoid = Input(VARIsVoid: bool)
VARmaterialName = Input(VARmaterialName: var = null)
VARsubcategoryName = Input(VARsubcategoryName: var = null)
code_block_10 = CodeBlock { false; }
VARMethodFalseIsImportedObjectTrueIsFami = Input(VARMethodFalseIsImportedObjectTrueIsFamily: var)
code_block_11 = CodeBlock { true; }
ne = VARMethodFalseIsImportedObjectTrueIsFami != code_block_11
k_family_insert = Custom[K-Family Insert](VARGeometryorSAT=scopeIf_9, VAROneFamily=VAROneFamily, VARAvoidConfilct=VARAutoSequenceNamingSuffix, VARFamilyName=VARFamilyName, VARFamilyNumber=VARStartSequenceNamingSuffix, VARFamilyCategory=VARFamilyCategory, VARFamilyTemplatePath=VARFamilyTemplate, VARIsShared=VARisShared, VARToVoid=VARIsVoid, VARMaterialName=VARmaterialName, VARSubcategory=VARsubcategoryName, VARSelfOrigin=code_block_10, VARDocumentImportMethod=code_block_6.out1, VARImportInstanceInstead=ne)  # K-Family Insert
string_from_object = FromObject(obj=k_family_insert.VARFamilyNumber)
code_block_12 = CodeBlock { "."; }
split = String.Split(str=string_from_object, separator0=code_block_12)
firstItem = List.FirstItem(list=split@L2)
toNumber = String.ToNumber(str=firstItem)
firstItem_2 = List.FirstItem(list=toNumber)
VARStartSequenceNamingSuffix_2 = Output(firstItem_2)  # "VARStartSequenceNamingSuffix"
firstItem_3 = List.FirstItem(list=k_family_insert.VARFamilyInstancesOrImportSymbols)
code_block_13 = CodeBlock { false; }
clean_3 = List.Clean(list=firstItem_3, preserveIndices=code_block_13)
flatten_9 = List.Flatten(list=clean_3)
VARRElements = Output(flatten_9)
VARExportSAT = Input(VARExportSAT: var)
empty_5 = List.Empty()
scopeIf_10 = Custom[CW.ScopeIf+](VARtest=VARExportSAT, VARtrue=flatten_7, VARfalse=empty_5)
VARSATFilepath = Input(VARSATFilepath: var)
scopeIf_11 = Custom[CW.ScopeIf+](VARtest=VARExportSAT, VARtrue=VARSATFilepath, VARfalse=empty_5)
exportToSAT = Geometry.ExportToSAT(geometry=scopeIf_10, filePath=scopeIf_11)
VARSATExport = Output(exportToSAT)
VARFamily = Output(k_family_insert.VARFamily)
VARToIntesectLines = Output(generate_t_lines.VARModelCurve)
scopeIf_12 = Custom[CW.ScopeIf+](VARtest=VARImportToRevit, VARtrue=VARDrawIntersects, VARfalse=code_block_8)
types = Family.Types(family=firstItem_3)
all_elements_of_family_type = ElementsOfFamilyType(Family_Type=types)
flatten_10 = List.Flatten(list=all_elements_of_family_type)
create_2 = List.Create(item0=firstItem_3, item1=flatten_10)
code_block_14 = CodeBlock { false; }
clean_4 = List.Clean(list=create_2, preserveIndices=code_block_14)
flatten_11 = List.Flatten(list=clean_4)
empty_6 = List.Empty()
scopeIf_13 = Custom[CW.ScopeIf+](VARtest=scopeIf_12, VARtrue=flatten_11, VARfalse=empty_6)
VARToIntesectElements = Output(scopeIf_13)
