# Dynamo custom node Underlay Visual Analyse.dyf (Dynamo 2.1.0.7500)
# category: Synthesize.Automate.Views
# Underlay Visual Analyse

join = List.Join()  # unwired: list0, list1
VARScopeBox = Input(VARScopeBox: var[]..[])
boundingBox = Element.BoundingBox(element=VARScopeBox)
toCuboid = BoundingBox.ToCuboid(boundingBox=boundingBox)
explode = Geometry.Explode(geometry=toCuboid)
filterByOrientation = Custom[CW.Surface.FilterByOrientation](VARsurfaces=explode)  # Sorts surfaces in three lists based on their orientation (vertical, horizontal up & horizontal down) and also returns three corresponding lists of booleans.
geometry = Element.Geometry(element=VARScopeBox)
intersectAll = Geometry.IntersectAll(geometry=filterByOrientation.VARhorizontalUp, others=geometry, lacing=Longest)
flatten = List.Flatten(list=intersectAll)
code_block = CodeBlock { "Line"; }
byClassName = Custom[SP.Filter.ByClassName](VARobject=flatten, VARclassName=code_block)  # Filters a list of objects by the object's class name. Note that Dynamo elements belong to different classes than their Revit counterparts. Use the Object.Class node to check an object's class.
as_polycurve_bycurves = Custom[AS.[&] PolyCurve.ByCurves](VARcurves=byClassName.VARin)  # Create polycurves from an unordered list of curves.
intersectAll_2 = Geometry.IntersectAll(geometry=filterByOrientation.VARhorizontalDown, others=geometry, lacing=Longest)
flatten_2 = List.Flatten(list=intersectAll_2)
code_block_2 = CodeBlock { "Line"; }
byClassName_2 = Custom[SP.Filter.ByClassName](VARobject=flatten_2, VARclassName=code_block_2)
as_polycurve_bycurves_2 = Custom[AS.[&] PolyCurve.ByCurves](VARcurves=byClassName_2.VARin)
join_2 = List.Join(list0=as_polycurve_bycurves.VARpolyCurve, list1=as_polycurve_bycurves_2.VARpolyCurve)
byLoft = Solid.ByLoft(crossSections=join_2)
VAR1ExactName2ContainsName3All = Input(VAR1ExactName2ContainsName3All: var[]..[])
code_block_3 = CodeBlock { 1; 2; 3; }
eq = VAR1ExactName2ContainsName3All == code_block_3.out0
VARFalseFloorPlansTrueCeilingPlans = Input(VARFalseFloorPlansTrueCeilingPlans: var[]..[])
mod_get_views_by_type = Custom[MOD.Get Views By Type]()  # Get all views in the project classified by type
scopeIf = Custom[CW.ScopeIf+](VARtest=VARFalseFloorPlansTrueCeilingPlans, VARtrue=mod_get_views_by_type.VARceilingPlans, VARfalse=mod_get_views_by_type.VARfloorPlans)  # A (hopefully) more robust implementation of ScopeIf. Tests a single boolean and returns a value accordingly.

# group: Get All Views of Types ViewPlan
watch = Watch(scopeIf)

getParameterValueByName = Element.GetParameterValueByName(element=scopeIf)  # unwired: parameterName
as_list_sortbykey = Custom[AS.[&] List.SortByKey](VARlist=watch, VARkeys=getParameterValueByName)  # Sort a list (or lists) according to the order specified by the key list.

# group: Capture View Names
name = Element.Name(element=as_list_sortbykey.VARsortedlist)
watch_2 = Watch(name)

VARName = Input(VARName: var[]..[])
eq_2 = watch_2 == VARName

# group: Filter View List By Exact Name
filterByBoolMask = List.FilterByBoolMask(list=as_list_sortbykey.VARsortedlist, mask=eq_2)

empty = List.Empty()
scopeIf_2 = Custom[CW.ScopeIf+](VARtest=eq, VARtrue=filterByBoolMask.in, VARfalse=empty)
eq_3 = VAR1ExactName2ContainsName3All == code_block_3.out1
boolean = BoolSelector(true)

# group: Connect Node to Filter by String.Contains Logic
contains = String.Contains(str=watch_2, searchFor=VARName, ignoreCase=boolean)
watch_3 = Watch(contains)

# group: Filter View List by Containment Name
filterByBoolMask_2 = List.FilterByBoolMask(list=as_list_sortbykey.VARsortedlist, mask=watch_3)

scopeIf_3 = Custom[CW.ScopeIf+](VARtest=eq_3, VARtrue=filterByBoolMask_2.in, VARfalse=empty)
eq_4 = VAR1ExactName2ContainsName3All == code_block_3.out2
scopeIf_4 = Custom[CW.ScopeIf+](VARtest=eq_4, VARtrue=as_list_sortbykey.VARsortedlist, VARfalse=empty)
create = List.Create(item0=scopeIf_2, item1=scopeIf_3, item2=scopeIf_4)
code_block_4 = CodeBlock { false; }
clean = List.Clean(list=create, preserveIndices=code_block_4)
flatten_3 = List.Flatten(list=clean)
code_block_5 = CodeBlock { "Range: Top Level"; "Range: Base Level"; "Underlay Orientation"; }
getParameterValueByName_2 = Element.GetParameterValueByName(element=flatten_3, parameterName=code_block_5.out1)
code_block_6 = CodeBlock { "None"; }
eq_5 = getParameterValueByName_2 == code_block_6
filterByBoolMask_3 = List.FilterByBoolMask(list=getParameterValueByName_2, mask=eq_5)
plane = Custom[CW.Level.Plane](VARlevel=filterByBoolMask_3.out)  # Retrieves the plane of a given level
origin = Plane.Origin(plane=plane)
getParameterValueByName_3 = Element.GetParameterValueByName(element=flatten_3, parameterName=code_block_5.out0)
filterByBoolMask_4 = List.FilterByBoolMask(list=getParameterValueByName_3, mask=eq_5)
plane_2 = Custom[CW.Level.Plane](VARlevel=filterByBoolMask_4.out)
origin_2 = Plane.Origin(plane=plane_2)
XYZ = Custom[LF.Point.XYZ](VARpoint=origin)  # Get the X, Y, and Z components of a Point
VARUnboundedDistance = Input(VARUnboundedDistance: var[]..[])
code_block_7 = CodeBlock(a=VARUnboundedDistance) { a-1; }
convert_between_units = DynamoConvert(code_block_7, MeasurementType="Length", FromConversion="Meters", ToConversion="Feet")
unit_types = UnitTypes("Length")
displayUnitType = Custom[CW.UnitType.DisplayUnitType](VARunitType=unit_types)  # Retrieves the display unit type for a given unit type.
toDisplayUnit = Custom[CW.InternalUnit.ToDisplayUnit](VARval=convert_between_units, VARdisplayUnitType=displayUnitType.VARdisplayUnitType)  # Converts a value from Revit's internal unit to a given display unit
add = XYZ.VARZ + toDisplayUnit
byCoordinates = Point.ByCoordinates(x=XYZ.VARX, y=XYZ.VARY, z=add)
isNull = Object.IsNull()  # unwired: obj
replaceByCondition = Replace(item=origin_2, replaceWith=byCoordinates, condition=isNull)
byStartPointEndPoint = Line.ByStartPointEndPoint(startPoint=origin, endPoint=replaceByCondition)
length = Curve.Length(curve=byStartPointEndPoint)
sum = Math.Sum(values=length)
scale = Geometry.Scale(geometry=byLoft, zamount=sum)
byOriginNormal = Plane.ByOriginNormal(origin=replaceByCondition)
intersect = Geometry.Intersect(geometry=scale, other=byOriginNormal)
translate = Geometry.Translate(geometry=intersect)
perimeterCurves = Surface.PerimeterCurves(surface=translate)
as_polycurve_bycurves_3 = Custom[AS.[&] PolyCurve.ByCurves](VARcurves=perimeterCurves)
flatten_4 = List.Flatten(list=as_polycurve_bycurves_3.VARpolyCurve@L2)
intersect_2 = Geometry.Intersect(geometry=scale, other=plane)
translate_2 = Geometry.Translate(geometry=intersect_2)
perimeterCurves_2 = Surface.PerimeterCurves(surface=translate_2)
as_polycurve_bycurves_4 = Custom[AS.[&] PolyCurve.ByCurves](VARcurves=perimeterCurves_2)
flatten_5 = List.Flatten(list=as_polycurve_bycurves_4.VARpolyCurve@L2)
combine = List.Combine(comb=join, list1=flatten_4, list2=flatten_5)
byLoft_2 = Solid.ByLoft()  # unwired: crossSections
map = List.Map(list=combine, f_x=byLoft_2)
explode_2 = Geometry.Explode(geometry=map)
filterByOrientation_2 = Custom[CW.Surface.FilterByOrientation](VARsurfaces=explode_2)
code_block_8 = CodeBlock { 5; }
gridFromFace = Custom[CW.Paneling.GridFromFace](VARsurface=filterByOrientation_2.VARhorizontalUp, VARU=code_block_8, VARV=code_block_8)  # Returns UV coordinates, XYZ coordinates and normals for a face with UV subdivision
gridFromFace_2 = Custom[CW.Paneling.GridFromFace](VARsurface=filterByOrientation_2.VARhorizontalDown, VARU=code_block_8, VARV=code_block_8)
byStartPointEndPoint_2 = Line.ByStartPointEndPoint(startPoint=gridFromFace.VARPoints, endPoint=gridFromFace_2.VARPoints)
flatten_6 = List.Flatten(list=byStartPointEndPoint_2@L2)
getParameterValueByName_4 = Element.GetParameterValueByName(element=flatten_3, parameterName=code_block_5.out2)
filterByBoolMask_5 = List.FilterByBoolMask(list=getParameterValueByName_4, mask=eq_5)
code_block_9 = CodeBlock { 0; }
eq_6 = filterByBoolMask_5.out == code_block_9
code_block_10 = CodeBlock { 1; 0; }
scopeIf_5 = Custom[CW.ScopeIf+](VARtest=eq_6, VARtrue=code_block_10.out0, VARfalse=code_block_10.out1, lacing=Longest)
pointAtParameter = Curve.PointAtParameter(curve=flatten_6@L2, param=scopeIf_5, lacing=Longest)
ZAxis = Vector.ZAxis()
reverse = Vector.Reverse(vector=ZAxis)
scopeIf_6 = Custom[CW.ScopeIf+](VARtest=eq_6, VARtrue=ZAxis, VARfalse=reverse, lacing=Longest)
length_2 = Curve.Length(curve=flatten_6)
code_block_11 = CodeBlock { 1; }
div = length_2 / code_block_11
translate_3 = Geometry.Translate(geometry=pointAtParameter, direction=scopeIf_6, distance=div)
byStartPointEndPoint_3 = Line.ByStartPointEndPoint(startPoint=pointAtParameter, endPoint=translate_3)
startPoint = Curve.StartPoint(curve=byStartPointEndPoint_3)
code_block_12 = CodeBlock { 0.5; }
pointAtParameter_2 = Curve.PointAtParameter(curve=byStartPointEndPoint_3, param=code_block_12)
XAxis = Vector.XAxis()
code_block_13 = CodeBlock { 2; }
toDisplayUnit_2 = Custom[CW.InternalUnit.ToDisplayUnit](VARval=code_block_13, VARdisplayUnitType=displayUnitType.VARdisplayUnitType)
translate_4 = Geometry.Translate(geometry=pointAtParameter_2, direction=XAxis, distance=toDisplayUnit_2)
byStartPointEndPoint_4 = Line.ByStartPointEndPoint(startPoint=startPoint, endPoint=translate_4)
reverse_2 = Vector.Reverse(vector=XAxis)
translate_5 = Geometry.Translate(geometry=pointAtParameter_2, direction=reverse_2, distance=toDisplayUnit_2)
byStartPointEndPoint_5 = Line.ByStartPointEndPoint(startPoint=startPoint, endPoint=translate_5)
YAxis = Vector.YAxis()
translate_6 = Geometry.Translate(geometry=pointAtParameter_2, direction=YAxis, distance=toDisplayUnit_2)
byStartPointEndPoint_6 = Line.ByStartPointEndPoint(startPoint=startPoint, endPoint=translate_6)
reverse_3 = Vector.Reverse(vector=YAxis)
translate_7 = Geometry.Translate(geometry=pointAtParameter_2, direction=reverse_3, distance=toDisplayUnit_2)
byStartPointEndPoint_7 = Line.ByStartPointEndPoint(startPoint=startPoint, endPoint=translate_7)
create_2 = List.Create(item0=byStartPointEndPoint_4, item1=byStartPointEndPoint_5, item2=byStartPointEndPoint_6, item3=byStartPointEndPoint_7, item4=byStartPointEndPoint_3)
code_block_14 = CodeBlock { false; }
clean_2 = List.Clean(list=create_2, preserveIndices=code_block_14)
flatten_7 = List.Flatten(list=clean_2)
hot_get_revit_activeview = Custom[HOT.Get Revit ActiveView]()  # Active View
fromCurve = Custom[CW.DetailLine.FromCurve](VARcurve=flatten_7, VARview=hot_get_revit_activeview)  # Creates a detail line based on a given curve
code_block_15 = CodeBlock { "Line Style"; }
element_types = ElementTypes("GraphicsStyle")
all_elements_of_type = ElementsOfType(element_type=element_types)
name_2 = Element.Name(element=all_elements_of_type)
VARLinestyleToUse = Input(VARLinestyleToUse: var[]..[])
eq_7 = name_2 == VARLinestyleToUse
filterByBoolMask_6 = List.FilterByBoolMask(list=all_elements_of_type, mask=eq_7)
firstItem = List.FirstItem(list=filterByBoolMask_6.in)
setParameterByName = Element.SetParameterByName(element=fromCurve, parameterName=code_block_15, value=firstItem)
code_block_16 = CodeBlock { "View Name"; }
VARDetailCurve = Output(fromCurve)
VARView = Output(flatten_3)
code_block_17 = CodeBlock(a=flatten_3) { a[0]; }
