# Dynamo custom node Understand Quad Faces.dyf (Dynamo 2.1.0.7500)
# category: Synthesize.Automate.Surface
# Try to Normalize Faces

VARUnderstandorNot = Input(VARUnderstandorNot: var[]..[])
VARSurfaces = Input(VARSurfaces: var[]..[])
flatten = List.Flatten(list=VARSurfaces)
empty = List.Empty()
scopeIf = Custom[CW.ScopeIf+](VARtest=VARUnderstandorNot, VARtrue=flatten, VARfalse=empty)  # A (hopefully) more robust implementation of ScopeIf. Tests a single boolean and returns a value accordingly.
update_dynamo_wait = Custom[Update Dynamo Wait](VARWait=scopeIf)  # Update Dynamo Wait
flatten_2 = List.Flatten(list=update_dynamo_wait)
turnIntoList = Custom[CW.TurnIntoList](VARunknownItem=flatten_2)  # Turns an element (or a nested list) into a flat list
isPlanar = Custom[CW.Surface.IsPlanar](VARsurface=turnIntoList)  # Checks whether a face is planar
filterByBoolMask = List.FilterByBoolMask(list=turnIntoList, mask=isPlanar)
perimeterCurves = Surface.PerimeterCurves(surface=filterByBoolMask.in)
as_polycurve_bycurves = Custom[AS.[&] PolyCurve.ByCurves](VARcurves=perimeterCurves)  # Create polycurves from an unordered list of curves.
python_script = Python(IN[0]=as_polycurve_bycurves.VARpolyCurve)
# ---------- python_script.python (74 lines) ----------
# Enable Python support and load DesignScript library
# IMPORTANT : ALL DYNAMO DESIGN SCRIPT NODES ARE AS (dg)
import clr
clr.AddReference('ProtoGeometry')
from Autodesk.DesignScript import Geometry as dg

# EXTENSION Enable ToDSType
clr.AddReference('RevitNodes')
import Revit
clr.ImportExtensions(Revit.Elements)

# Enable Revit Elements
from Revit.Elements import *

# EXTENSION Enable Geometry Conversion Methods
clr.ImportExtensions(Revit.GeometryConversion)

# Enable Revit API
clr.AddReference('RevitAPI')
from Autodesk.Revit.DB import *

# Enable DocumentManager and TransactionManager
clr.AddReference('RevitServices')
from RevitServices.Persistence import DocumentManager
from RevitServices.Transactions import TransactionManager

# Enable ICollection List Translate
clr.AddReference("System")
import System.Collections.Generic
from System.Collections.Generic import List

dataEnteringNode = IN
# Use UnwrapElement(IN[0]) When Translating From Dynamo to Revit
curvelist=UnwrapElement(IN[0])

# Choose The Current Document
doc = DocumentManager.Instance.CurrentDBDocument
uidoc = DocumentManager.Instance.CurrentUIApplication.ActiveUIDocument
uiapp = DocumentManager.Instance.CurrentUIApplication
app = uiapp.Application

# Create Empty List
result = []
minstuff = []
for clist in curvelist:
	areas = []
	perms = []
	for c in clist:
		try:
			areas.append(dg.Surface.ByPatch(c).Area)
			perms.append(c.Length)
		except:
			areas.append(None)
			perms.append(c.Length)
		if None in areas:
			maxn = max(perms)
			maxind = perms.index(maxn)
		else:
			maxn = max(areas)
			maxind = areas.index(maxn)
	result.append(clist[maxind])
	tmpstuff = []
	counter = 0
	for cc in clist:
		if counter != maxind:
			tmpstuff.append(cc)
		counter += 1
	if len(tmpstuff) != 0:
		minstuff.append(tmpstuff)
	else:
		minstuff.append([None])
		
# Assign your output to the OUT variable.
OUT = result,minstuff
# ----------------------------------------
code_block = CodeBlock(a=python_script) { a[0]; }
code_block_2 = CodeBlock { 1; }
chop = List.Chop(list=code_block, lengths=code_block_2)
trimWithEdgeLoops = Surface.TrimWithEdgeLoops(surface=filterByBoolMask.in, loops=chop)
flatten_3 = List.Flatten(list=trimWithEdgeLoops)
perimeterCurves_2 = Surface.PerimeterCurves(surface=flatten_3)
as_polycurve_bycurves_2 = Custom[AS.[&] PolyCurve.ByCurves](VARcurves=perimeterCurves_2)
curves = PolyCurve.Curves(polyCurve=as_polycurve_bycurves_2.VARpolyCurve)
curves_offset_to_revit = Custom[Curves Offset To Revit Compatibility](VARCurves=curves@@L3)  # Curves Offset To Revit Compatibility
curves_to_quad_surface = Custom[Curves to Quad Surface](VARSurfaces=curves_offset_to_revit.VARCurves@L3)  # Understand Quad Faces
python_script_2 = Python(IN[0]=curves_to_quad_surface, IN[1]=flatten_3)
# ---------- python_script_2.python (70 lines) ----------
# Enable Python support and load DesignScript library
# IMPORTANT : ALL DYNAMO DESIGN SCRIPT NODES ARE AS (dg)
import clr
clr.AddReference('ProtoGeometry')
from Autodesk.DesignScript import Geometry as dg

# EXTENSION Enable ToDSType
clr.AddReference('RevitNodes')
import Revit
clr.ImportExtensions(Revit.Elements)

# Enable Revit Elements
from Revit.Elements import *

# EXTENSION Enable Geometry Conversion Methods
clr.ImportExtensions(Revit.GeometryConversion)

# Enable Revit API
clr.AddReference('RevitAPI')
from Autodesk.Revit.DB import *

# Enable DocumentManager and TransactionManager
clr.AddReference('RevitServices')
from RevitServices.Persistence import DocumentManager
from RevitServices.Transactions import TransactionManager

# Enable ICollection List Translate
clr.AddReference("System")
import System.Collections.Generic
from System.Collections.Generic import List

dataEnteringNode = IN
# Use UnwrapElement(IN[0]) When Translating From Dynamo to Revit
surfs=UnwrapElement(IN[0])
orgsurfs=UnwrapElement(IN[1])

# Choose The Current Document
doc = DocumentManager.Instance.CurrentDBDocument
uidoc = DocumentManager.Instance.CurrentUIApplication.ActiveUIDocument
uiapp = DocumentManager.Instance.CurrentUIApplication
app = uiapp.Application

# Create Empty List
result = []

count = 0
for s in surfs:
	if None in s:
		result.append(orgsurfs[count])
	elif len(s) > 1:
		areas = []
		for sinside in s:
			areas.append(sinside.Area)
		maxarea = max(areas)
		maxindex = areas.index(maxarea)
		maxsurf = s[maxindex]
		smallsurfs = []
		tmpcounter = 0
		for stmp in s:
			if tmpcounter != maxindex:
				smallsurfs.append(stmp)
			tmpcounter += 1
		subbed = dg.Surface.Difference(maxsurf,smallsurfs)
		result.append(subbed)
	else:
		result.append(s[0])
	count += 1

# Assign your output to the OUT variable.
OUT = result
# ----------------------------------------
code_block_3 = CodeBlock(a=python_script) { a[1]; }
trimWithEdgeLoops_2 = Surface.TrimWithEdgeLoops(surface=python_script_2, loops=code_block_3)
python_script_3 = Python(IN[0]=python_script_2, IN[1]=trimWithEdgeLoops_2)
# ---------- python_script_3.python (53 lines) ----------
# Enable Python support and load DesignScript library
# IMPORTANT : ALL DYNAMO DESIGN SCRIPT NODES ARE AS (dg)
import clr
clr.AddReference('ProtoGeometry')
from Autodesk.DesignScript import Geometry as dg

# EXTENSION Enable ToDSType
clr.AddReference('RevitNodes')
import Revit
clr.ImportExtensions(Revit.Elements)

# Enable Revit Elements
from Revit.Elements import *

# EXTENSION Enable Geometry Conversion Methods
clr.ImportExtensions(Revit.GeometryConversion)

# Enable Revit API
clr.AddReference('RevitAPI')
from Autodesk.Revit.DB import *

# Enable DocumentManager and TransactionManager
clr.AddReference('RevitServices')
from RevitServices.Persistence import DocumentManager
from RevitServices.Transactions import TransactionManager

# Enable ICollection List Translate
clr.AddReference("System")
import System.Collections.Generic
from System.Collections.Generic import List

dataEnteringNode = IN
# Use UnwrapElement(IN[0]) When Translating From Dynamo to Revit
surfs=UnwrapElement(IN[0])
surfstosub=UnwrapElement(IN[1])

# Choose The Current Document
doc = DocumentManager.Instance.CurrentDBDocument
uidoc = DocumentManager.Instance.CurrentUIApplication.ActiveUIDocument
uiapp = DocumentManager.Instance.CurrentUIApplication
app = uiapp.Application

# Create Empty List
result = []
counter = 0
for s in surfs:
	try:
		result.append(dg.Surface.Difference(s,[surfstosub[counter]]))
	except:
		result.append(s)
	counter += 1
# Assign your output to the OUT variable.
OUT = result
# ----------------------------------------
mergeByBoolMask = Custom[SP.List.MergeByBoolMask](VARIn=python_script_3, VAROut=filterByBoolMask.out, VARmask=isPlanar)  # Merge two lists by a boolean mask list. The true count in the mask should be the same as the length of the true list and vice versa for the false list.
scopeIf_2 = Custom[CW.ScopeIf+](VARtest=VARUnderstandorNot, VARtrue=mergeByBoolMask, VARfalse=flatten)
VARNurbsSurface = Output(scopeIf_2)
