# Dynamo custom node Update Dynamo Wait.dyf (Dynamo 2.1.0.7500)
# category: Synthesize.Software
# Update Dynamo Wait

VARWait = Input(VARWait: var[]..[])
VARVersion = Input(VARVersion: double = 2.3)
VARShowMsg = Input(VARShowMsg: bool = true)
python_script = Python(IN[0]=VARWait, IN[1]=VARVersion, IN[2]=VARShowMsg)
# ---------- python_script.python (62 lines) ----------
# Enable Python support and load DesignScript library
# IMPORTANT : ALL DYNAMO DESIGN SCRIPT NODES ARE AS (dg)
import clr
clr.AddReference('ProtoGeometry')
from Autodesk.DesignScript import Geometry as dg

# EXTENSION Enable ToDSType
clr.AddReference('RevitNodes')
import Revit
clr.ImportExtensions(Revit.Elements)

# Enable Revit Elements
from Revit.Elements import *

# EXTENSION Enable Geometry Conversion Methods
clr.ImportExtensions(Revit.GeometryConversion)

# Enable Revit API
clr.AddReference('RevitAPI')
from Autodesk.Revit.DB import *

# Enable DocumentManager and TransactionManager
clr.AddReference('RevitServices')
from RevitServices.Persistence import DocumentManager
from RevitServices.Transactions import TransactionManager

# Enable ICollection List Translate
clr.AddReference("System")
import System.Collections.Generic
from System.Collections.Generic import List

clr.AddReference('DynamoRevitDS')
import Dynamo 
clr.AddReference("RevitAPIUI")
from Autodesk.Revit.UI import TaskDialog

import System
pf_path = System.Environment.GetFolderPath(System.Environment.SpecialFolder.ProgramFilesX86)
import sys
sys.path.append('%s\IronPython 2.7\Lib' %pf_path)
from distutils.version import LooseVersion

input = IN[0]
targetversion = IN[1]
showmsg = IN[2]


msg = "Please Update Revit/Dynamo"
title = "AECedx - Karam"
alert = TaskDialog
script = Dynamo.Applications.DynamoRevit().RevitDynamoModel.CurrentWorkspace.FileName.split("\\")[-1]
version = Dynamo.Applications.DynamoRevit().RevitDynamoModel.Version
tranversion = version.split(".")[0:2]
numversion = ".".join(tranversion)

if LooseVersion(numversion) < LooseVersion(str(targetversion)) and input != [] and input != None:
	if showmsg == True:
		OUT = alert.Show(title, msg)
	else:
		OUT = "Stopping"
else:
	OUT = input
# ----------------------------------------
VAROUT = Output(python_script)
