# Dynamo custom node Vector of Curve By Points.dyf (Dynamo 2.1.0.7500)
# category: Synthesize.Automate.Lines
# Vector of Curve By Points

VARCurveByPoints = Input(VARCurveByPoints: var[]..[])
VARCurveGeometry = Input(VARCurveGeometry: var[]..[])
VARHelpingSurfs = Input(VARHelpingSurfs: bool = false)
python_script = Python(IN[0]=VARCurveByPoints, IN[1]=VARCurveGeometry, IN[2]=VARHelpingSurfs)
# ---------- python_script.python (191 lines) ----------
# Enable Python support and load DesignScript library
# IMPORTANT : ALL DYNAMO DESIGN SCRIPT NODES ARE AS (dg)
import clr
clr.AddReference('ProtoGeometry')
from Autodesk.DesignScript import Geometry as dg

# EXTENSION Enable ToDSType
clr.AddReference('RevitNodes')
import Revit
clr.ImportExtensions(Revit.Elements)

# Enable Revit Elements
from Revit.Elements import *

# EXTENSION Enable Geometry Conversion Methods
clr.ImportExtensions(Revit.GeometryConversion)

# Enable Revit API
clr.AddReference('RevitAPI')
from Autodesk.Revit.DB import *

# Enable DocumentManager and TransactionManager
clr.AddReference('RevitServices')
from RevitServices.Persistence import DocumentManager
from RevitServices.Transactions import TransactionManager

# Enable ICollection List Translate
clr.AddReference("System")
import System.Collections.Generic
from System.Collections.Generic import List

def flatten(x):
    result = []
    for el in x:
        if hasattr(el, "__iter__") and not isinstance(el, basestring):
            result.extend(flatten(el))
        else:
            result.append(el)
    return result

opt1 = Options()
opt1.ComputeReferences = True

# Choose The Current Document
doc = DocumentManager.Instance.CurrentDBDocument
uidoc = DocumentManager.Instance.CurrentUIApplication.ActiveUIDocument
uiapp = DocumentManager.Instance.CurrentUIApplication
app = uiapp.Application

if int(DocumentManager.Instance.CurrentUIApplication.Application.VersionNumber) < 2021:
	safefactor = UnitUtils.ConvertFromInternalUnits(5,doc.GetUnits().GetFormatOptions(UnitType.UT_Length).DisplayUnits)
else:
	safefactor = UnitUtils.ConvertFromInternalUnits(5,doc.GetUnits().GetFormatOptions(SpecTypeId.Length).GetUnitTypeId())

def getvec(m,tran):
	try:
		pts = m.GetPoints()
		for p in pts:
			pointreference = p.GetPointElementReference()
			ptsref = pointreference.ToString()
			if ptsref == "Autodesk.Revit.DB.PointOnPlane":
				bestplane = doc.GetElement(p.GetPointElementReference().GetPlaneReference().ElementId).GetPlane().ToPlane().Normal
				break
			elif ptsref == "Autodesk.Revit.DB.PointOnEdge" or "Autodesk.Revit.DB.PointOnFace":
				wantedpoint = dg.Curve.PointAtParameter(tran,0.5)
				if ptsref == "Autodesk.Revit.DB.PointOnEdge":
					formelem = doc.GetElement((p.GetPointElementReference().GetEdgeReference().ElementId))
				elif ptsref == "Autodesk.Revit.DB.PointOnFace":
					formelem = doc.GetElement((p.GetPointElementReference().GetFaceReference().ElementId))
				if formelem.ToString() == "Autodesk.Revit.DB.DividedSurface":
					formelem = formelem.Host
				geoms = formelem.get_Geometry(opt1)
				trangeoms = []
				stopit = False
				for g in geoms:
					try:
						faces = g.Faces
					except:
						for ge in geoms:
							bestplane = formelem
							break
						stopit = True
						break
					for f in faces:
						trangeoms.append(f.ToProtoType(True))
				if stopit == False:
					trangeoms = flatten(trangeoms)
					distances = []
					for t in trangeoms:
						distances.append(dg.Geometry.DistanceTo(wantedpoint,t))
					minimumdis = min(distances)
					if minimumdis > safefactor:
						bestplane = None
					else:
						incount = 0
						for d in distances:
							if d == minimumdis:
								wantedsurf = trangeoms[incount]
							incount += 1
						bestplane = dg.Surface.NormalAtPoint(wantedsurf,wantedpoint)
				break
	except:
		bestplane = None
		p = None
	return bestplane,p

def getvectwo(faces,tran,pt):
	try:
		trangeoms = flatten(faces)
		try:
			wantedpoint = dg.Curve.PointAtParameter(tran,0.5)
		except:
			wantedpoint = pt.GetCoordinateSystem().Origin.ToPoint()
		distances = []
		for t in trangeoms:
			distances.append(dg.Geometry.DistanceTo(UnwrapElement(wantedpoint),t))
		minimumdis = min(distances)
		if minimumdis > safefactor:
			return None
		incount = 0
		for d in distances:
			if d == minimumdis:
				wantedsurf = trangeoms[incount]
			incount += 1
		bestplane = dg.Surface.NormalAtPoint(wantedsurf,wantedpoint)
	except:
		bestplane = None
	return bestplane

dataEnteringNode = IN
# Use UnwrapElement(IN[0]) When Translating From Dynamo to Revit
modelcurves=UnwrapElement(IN[0])
trancurves=UnwrapElement(IN[1])
helping=IN[2]

# Create Empty List
result = []
counter = 0
for m in modelcurves:
	vecto = getvec(m,trancurves[counter])
	testit = vecto[0]
	try:
		isfamily = testit.ToString() == "Autodesk.Revit.DB.FamilyInstance"
	except:
		isfamily = False
	pt = vecto[1]
	if isfamily == True:
		if helping:
			result.append(None)
		else:
			try:
				try:
					geoms = Revit.Elements.Element.Geometry(testit.ToDSType(True))
				except:
				 	pass
			except:
				pass
			faces = []
			for g in geoms:
				if g.ToString() == "Solid":
					faces = dg.Geometry.Explode(g)
					faces = flatten(faces)
					g.Dispose()
				elif g.ToString() == "Surface":
					faces.append(g)
			vectotwo = getvectwo(faces,trancurves[counter],pt)
			testit = vectotwo
			result.append(testit)
			for ff in faces:
				ff.Dispose()
	elif hasattr(testit, 'AngleAboutAxis'):
	    result.append(testit)
	else:
		vectothree = getvec(testit,trancurves[counter])
		testit = vectothree[0]
		result.append(testit)
	counter += 1

finalcheck = []
count = 0
for m in trancurves:
	cur_vec = result[count]
	count += 1
	try:
		test = dg.Curve.Extrude(m,cur_vec,1)
		test.Dispose()
		finalcheck.append(cur_vec)
	except:
		finalcheck.append(None)

OUT = finalcheck
# ----------------------------------------
VAROut = Output(python_script)
