# Dynamo custom node Voronoi Function For K-Paneling.dyf (Dynamo 2.1.0.7500)
# category: Synthesize.Automate.Geometry
# Voronoi Function For K-Paneling

VARSurfaces = Input(VARSurfaces: var[]..[])
update_dynamo_wait = Custom[Update Dynamo Wait](VARWait=VARSurfaces)  # Update Dynamo Wait
VARDistancingMethodFalseIsNumbers = Input(VARDistancingMethodFalseIsNumbers: bool = false)
VARUDensity = Input(VARUDensity: int = 6)
VARVDensity = Input(VARVDensity: int = 6)
VARStraightness = Input(VARStraightness: double = 1)
VARXscale = Input(VARXscale: double = 1)
VARYscale = Input(VARYscale: double = 1)
VARZscale = Input(VARZscale: double = 1)
smart_voronoi_generator = Custom[Smart Voronoi Generator](VARSurfaces=update_dynamo_wait, VARDistancingMethodFalseIsNumbers=VARDistancingMethodFalseIsNumbers, VARUDensity=VARUDensity, VARVDensity=VARVDensity, VARStraightness=VARStraightness, VARXscale=VARXscale, VARYscale=VARYscale, VARZscale=VARZscale)  # Smart Voronoi Generator
isPlanar = Custom[CW.Surface.IsPlanar](VARsurface=smart_voronoi_generator.VARSurfaces)  # Checks whether a face is planar
filterByBoolMask = List.FilterByBoolMask(list=smart_voronoi_generator.VARJoinedCurves, mask=isPlanar)
explode = Geometry.Explode(geometry=filterByBoolMask.out)
flatten = List.Flatten(list=explode@L3)
as_overkill_bycurves = Custom[AS.[&] Overkill ByCurves](VARcurves=flatten)  # Create polycurves from an unordered list of curves.
mergeByBoolMask = Custom[SP.List.MergeByBoolMask](VARIn=filterByBoolMask.in, VAROut=as_overkill_bycurves, VARmask=isPlanar)  # Merge two lists by a boolean mask list. The true count in the mask should be the same as the length of the true list and vice versa for the false list.
VARPolyCurves = Output(mergeByBoolMask)
VARSurfaces_2 = Output(smart_voronoi_generator.VARSurfaces)  # "VARSurfaces"
code_block = CodeBlock { null; }
count = List.Count(list=smart_voronoi_generator.VARSurfaces)
ofRepeatedItem = List.OfRepeatedItem(item=code_block, amount=count)
code_block_2 = CodeBlock { 2; }
normalizeDepth = List.NormalizeDepth(list=ofRepeatedItem, rank=code_block_2)
VARVandWNulls = Output(normalizeDepth)
VARPreviewOnly = Input(VARPreviewOnly: bool = false)
empty = List.Empty()
scopeIf = Custom[CW.ScopeIf+](VARtest=VARPreviewOnly, VARtrue=smart_voronoi_generator.VARJoinedCurves, VARfalse=empty)  # A (hopefully) more robust implementation of ScopeIf. Tests a single boolean and returns a value accordingly.
explode_2 = Geometry.Explode(geometry=scopeIf)
flatten_2 = List.Flatten(list=explode_2)
startPoint = Curve.StartPoint(curve=flatten_2)
endPoint = Curve.EndPoint(curve=flatten_2)
byStartPointEndPoint = Line.ByStartPointEndPoint(startPoint=startPoint, endPoint=endPoint)
as_overkill_bycurves_2 = Custom[AS.[&] Overkill ByCurves](VARcurves=byStartPointEndPoint)
explode_3 = Geometry.Explode(geometry=as_overkill_bycurves_2)
flatten_3 = List.Flatten(list=explode_3)
byCurve = ModelCurve.ByCurve(curve=flatten_3)
VARPreviewModelCurves = Output(byCurve)
