# Dynamo custom node ZK.BoundingBox.Dimensions.dyf (Dynamo 2.1.0.7500)
# category: Synthesize.Packages.Zhukoven.Revit.BoundingBoxes
# Input Bounding Box element to get its dimensions (Width, Length, Height). Setting Boolean switch to True rounds output values.

VARroundvalues = Input(VARroundvalues: bool = false)
VARBoundingBox = Input(VARBoundingBox: var[]..[])
toCuboid = BoundingBox.ToCuboid(boundingBox=VARBoundingBox)
isNull = Object.IsNull(obj=toCuboid)
filterByBoolMask = List.FilterByBoolMask(list=toCuboid, mask=isNull)
width = Cuboid.Width(cuboid=filterByBoolMask.out)
round = Math.Round(number=width)
scopeIf = Custom[CW.ScopeIf+](VARtest=VARroundvalues, VARtrue=round, VARfalse=width)  # A (hopefully) more robust implementation of ScopeIf. Tests a single boolean and returns a value accordingly.
VARWidth = Output(scopeIf)
length = Cuboid.Length(cuboid=filterByBoolMask.out)
round_2 = Math.Round(number=length)
scopeIf_2 = Custom[CW.ScopeIf+](VARtest=VARroundvalues, VARtrue=round_2, VARfalse=length)
VARLength = Output(scopeIf_2)
height = Cuboid.Height(cuboid=filterByBoolMask.out)
round_3 = Math.Round(number=height)
scopeIf_3 = Custom[CW.ScopeIf+](VARtest=VARroundvalues, VARtrue=round_3, VARfalse=height)
VARHeight = Output(scopeIf_3)
VARNullList = Output(isNull)
