# Dynamo custom node ZK.BoundingBox.Point for Interference Check.dyf (Dynamo 2.1.0.7500)
# category: Synthesize.Automate.Clash Detection
# ZK.BoundingBox.Point for Interference Check

join = List.Join()  # unwired: list0, list1
VARBoundingBox = Input(VARBoundingBox: var[]..[])
maxPoint = BoundingBox.MaxPoint(boundingBox=VARBoundingBox)
X = Point.X(point=maxPoint)
minPoint = BoundingBox.MinPoint(boundingBox=VARBoundingBox)
Y = Point.Y(point=minPoint)
VARZofOriginalBoundingBoxMinPoint = Input(VARZofOriginalBoundingBoxMinPoint: var[]..[])
byCoordinates = Point.ByCoordinates(x=X, y=Y, z=VARZofOriginalBoundingBoxMinPoint)
Y_2 = Point.Y(point=maxPoint)
byCoordinates_2 = Point.ByCoordinates(x=X, y=Y_2, z=VARZofOriginalBoundingBoxMinPoint)
byStartPointEndPoint = Line.ByStartPointEndPoint(startPoint=byCoordinates, endPoint=byCoordinates_2)
code_block = CodeBlock { 0.25; }
pointAtParameter = Curve.PointAtParameter(curve=byStartPointEndPoint, param=code_block)
centerPoint = Custom[ZK.BoundingBox.CenterPoint](VARBoundingBox=VARBoundingBox)  # Input Bounding Box element to get its center point. This node is little and lightweight, as it doesn't convert bounding box to geometry to get its centroid point.
XYZ = Custom[LF.Point.XYZ](VARpoint=centerPoint)  # Get the X, Y, and Z components of a Point
byCoordinates_3 = Point.ByCoordinates(x=XYZ.VARX, y=XYZ.VARY, z=VARZofOriginalBoundingBoxMinPoint)
byStartPointEndPoint_2 = Line.ByStartPointEndPoint(startPoint=pointAtParameter, endPoint=byCoordinates_3)
X_2 = Point.X(point=minPoint)
byCoordinates_4 = Point.ByCoordinates(x=X_2, y=Y, z=VARZofOriginalBoundingBoxMinPoint)
byCoordinates_5 = Point.ByCoordinates(x=X, y=Y, z=VARZofOriginalBoundingBoxMinPoint)
byStartPointEndPoint_3 = Line.ByStartPointEndPoint(startPoint=byCoordinates_4, endPoint=byCoordinates_5)
pointAtParameter_2 = Curve.PointAtParameter(curve=byStartPointEndPoint_3, param=code_block)
byStartPointEndPoint_4 = Line.ByStartPointEndPoint(startPoint=pointAtParameter_2, endPoint=byCoordinates_3)
combine = List.Combine(comb=join, list1=byStartPointEndPoint_2, list2=byStartPointEndPoint_4)
join_2 = List.Join()  # unwired: list0, list1
length = Curve.Length(curve=byStartPointEndPoint_2)
length_2 = Curve.Length(curve=byStartPointEndPoint_4)
combine_2 = List.Combine(comb=join_2, list1=length, list2=length_2)
maximumItem = List.MaximumItem(list=combine_2)
eq = combine_2 == maximumItem
filterByBoolMask = List.FilterByBoolMask(list=combine, mask=eq)
VARDistancefromBoundingBoxFace = Input(VARDistancefromBoundingBoxFace: var[]..[])
pointAtSegmentLength = Curve.PointAtSegmentLength(curve=filterByBoolMask.in, segmentLength=VARDistancefromBoundingBoxFace)
firstItem = List.FirstItem(list=pointAtSegmentLength@L2)
XYZ_2 = Custom[LF.Point.XYZ](VARpoint=firstItem)
VARZofOriginalBoundingBoxCenterPoint = Input(VARZofOriginalBoundingBoxCenterPoint: var[]..[])
byCoordinates_6 = Point.ByCoordinates(x=XYZ_2.VARX, y=XYZ_2.VARY, z=VARZofOriginalBoundingBoxCenterPoint)
byStartPointEndPoint_5 = Line.ByStartPointEndPoint(startPoint=firstItem, endPoint=byCoordinates_6)
code_block_2 = CodeBlock { 0.5; }
pointAtParameter_3 = Curve.PointAtParameter(curve=byStartPointEndPoint_5, param=code_block_2)
VARPoints = Output(pointAtParameter_3)
