# Dynamo custom node ZK.Topography.PolySurface.dyf (Dynamo 2.1.0.7500)
# category: Synthesize.Packages.Zhukoven.Revit.Topography
# Convert topography element to polysurface

VARTopography = Input(VARTopography: var[]..[])
VARJointoPolysurface = Input(VARJointoPolysurface: bool = true)
VARFullTopo = Input(VARFullTopo: bool = false)
VAROnlyCurves = Input(VAROnlyCurves: bool = false)
VARFullTopoRemoveRegions = Input(VARFullTopoRemoveRegions: bool = true)
VARFullTopoRemovePads = Input(VARFullTopoRemovePads: bool = true)
python_script = Python(IN[0]=VARTopography, IN[1]=VARJointoPolysurface, IN[2]=VARFullTopo, IN[3]=VAROnlyCurves, IN[4]=VARFullTopoRemoveRegions, IN[5]=VARFullTopoRemovePads)
# ---------- python_script.python (227 lines) ----------
# Created By Karam Baki : karam@aecedx.com

import clr
clr.AddReference('ProtoGeometry')
from Autodesk.DesignScript import Geometry as dg

# EXTENSION Enable ToDSType
clr.AddReference('RevitNodes')
import Revit
clr.ImportExtensions(Revit.Elements)

# Enable Revit Elements
from Revit.Elements import *

# EXTENSION Enable Geometry Conversion Methods
clr.ImportExtensions(Revit.GeometryConversion)

# Enable Revit API
clr.AddReference('RevitAPI')
from Autodesk.Revit.DB import *

# Enable DocumentManager and TransactionManager
clr.AddReference('RevitServices')
from RevitServices.Persistence import DocumentManager
from RevitServices.Transactions import TransactionManager

# Enable ICollection List Translate
clr.AddReference("System")
import System.Collections.Generic
from System.Collections.Generic import List

import System
pf_path = System.Environment.GetFolderPath(System.Environment.SpecialFolder.ProgramFilesX86)
import sys
sys.path.append('%s\IronPython 2.7\Lib' %pf_path)

meshes, mergeAll, originaltopo, onlycurves, removeregions, removepads = IN[0],IN[1],IN[2],IN[3],IN[4],IN[5]
chunks = 12

def tolist(obj1):
	if hasattr(obj1,'__iter__'): return obj1
	return [obj1]

def flatten(x):
    result = []
    for el in x:
        if hasattr(el, "__iter__") and not isinstance(el, basestring):
            result.extend(flatten(el))
        else:
            result.append(el)
    return result

def get_topogeom(topo):
	topo = UnwrapElement(topo)
	opt = Options()
	geoms = topo.get_Geometry(opt)
	result = []
	original = []
	for g in geoms:
		try:
			result.append(g.ToProtoType())
			original.append(g)
		except:
			pass
	opt.Dispose()
	return result,original

def polysurfaceOP(surfaces,chunks=12):
	def smartpolysurface(surfaces,times,round=0):
		if len(surfaces) > chunks:
			if times == 0:
				return surfaces
			result = []
			chopped = [surfaces[x:x+chunks] for x in xrange(0, len(surfaces), chunks)]
			for chop in chopped:
				try:
					joined = dg.PolySurface.ByJoinedSurfaces(chop)
					if round != 0:
						for c in chop:
							c.Dispose()
					result.append(joined)
				except:
					for c in chop:
						result.append(c)
			times -= 1
			round += 1
			result = smartpolysurface(result,times,round)
			return result
		else:
			if isinstance(surfaces, dg.PolySurface):
				return surfaces
			else:
				return dg.PolySurface.ByJoinedSurfaces(surfaces)
	surfaces = flatten(tolist(surfaces))
	n = len(surfaces)
	times = 0
	while n > 1:
		n //= chunks
		times += 1
	times *= 1.5
	times = int(round(times))
	joined = smartpolysurface(surfaces,times)
	if isinstance(joined, list):
		try:
			joined = dg.PolySurface.ByJoinedSurfaces(joined)
		except:
			joined = joined[0]
	return joined

def meshjob(mesh):
	def m_polytosurf(poly):
		try:
			patched = dg.Surface.ByPerimeterPoints(poly.Points)
			poly.Dispose()
			return patched
		except:
			poly.Dispose()
			return None
	def meshtopoly(mesh):
		faces = mesh.FaceIndices
		points = mesh.VertexPositions
		patches = []
		for f in faces:
			try:
				poly = dg.Polygon.ByPoints([points[f.A],points[f.B],points[f.C]])
				patches.append(poly)
			except:
				continue
		for p in points:
			p.Dispose()
		return patches
	polygons = meshtopoly(mesh)
	surfaces = []
	for p in polygons:
		surfaces.append(m_polytosurf(p))
	surfaces = [i for i in surfaces if i]
	return surfaces

doc = DocumentManager.Instance.CurrentDBDocument
result = []
resultJ = []
if originaltopo == True:
	pads = FilteredElementCollector(doc).OfCategory(BuiltInCategory.OST_BuildingPad).WhereElementIsNotElementType().ToElements()
	allpads = []
	for p in pads:
		allpads.append(p)
	topo = FilteredElementCollector(doc).OfCategory(BuiltInCategory.OST_Topography).WhereElementIsNotElementType().ToElements()
	subregions = []
	for e in topo:
		if e.IsSiteSubRegion:
			subregions.append(e)
	todel = []
	fixedsubs = []
	meshes = tolist(meshes)
	for subReg in subregions:
		for meSH in meshes:
			if str(subReg.Id) == str(meSH.Id):
				fixedsubs.append(subReg)
	subregions = set(subregions) - set(fixedsubs)
	subregions = list(subregions)
	if removeregions:
		todel = todel + subregions
	if removepads:
		todel = todel + allpads
	todel = flatten(todel)
	
	TransactionManager.Instance.ForceCloseTransaction()
	trans1 = Transaction(doc, 'Magic')
	trans1.Start()
	for e in todel:
		try:
			doc.Delete(e.Id)
		except:
			pass
	doc.Regenerate()
	
	meshes = tolist(meshes)
	wantedmesh = []
	wantedpolies = []
	linestyles = []
	for m in meshes:
		getOP = get_topogeom(m)
		meshgeom = getOP[0]
		count = 0
		for e in meshgeom:
			e = UnwrapElement(e)
			if hasattr(e, 'ByPointsFaceIndices'):
			    wantedmesh.append(e)
			else:
				wantedpolies.append(e)
				linestyles.append(getOP[1][count].GraphicsStyleId)
			count += 1
	trans1.RollBack()
	TransactionManager.Instance.ForceCloseTransaction()
	if onlycurves != True:
		result = []
		for want in wantedmesh:
			result.append(meshjob(want))
		result = flatten(result)
		if mergeAll: resultJ = polysurfaceOP(result,chunks)
		else: resultJ = result
else:
	meshes = tolist(meshes)
	wantedmesh = []
	wantedpolies = []
	linestyles = []
	for m in meshes:
		getOP = get_topogeom(m)
		meshgeom = getOP[0]
		count = 0
		for e in meshgeom:
			e = UnwrapElement(e)
			if hasattr(e, 'ByPointsFaceIndices'):
			    wantedmesh.append(e)
			else:
				wantedpolies.append(e)
				linestyles.append(getOP[1][count].GraphicsStyleId)
			count += 1
	if onlycurves != True:
		result = []
		for want in wantedmesh:
			result.append(meshjob(want))
		result = flatten(result)
		if mergeAll: resultJ = polysurfaceOP(result,chunks)
		else: resultJ = result

OUT = resultJ,wantedpolies,meshes,result,linestyles
# ----------------------------------------
code_block = CodeBlock(a=python_script) { a[0]; a[1]; a[2]; a[4]; }
VARPolySurface = Output(code_block.out0)
VARPolyCurves = Output(code_block.out1)
select_all_topography_from = Custom[Select All Topography From Topography](VARTopography=code_block.out2)  # Select Subregions From Topography
VARSubregionsList = Output(select_all_topography_from.VARSubregionsList)
VARHostTopography = Output(select_all_topography_from.VARHostTopography)
VARLineStyleIds = Output(code_block.out3)
