# Dynamo graph ---Auto Update Synthesize---.dyn (Dynamo 2.13.1.3887)

python_script = Python()  # IronPython2; unwired: IN[0]
# ---------- python_script.python (55 lines) ----------
# Enable Python support and load DesignScript library
# IMPORTANT : ALL DYNAMO DESIGN SCRIPT NODES ARE AS (dg)
import sys
sys.path.append(r'C:\Program Files (x86)\IronPython 2.7\DLLs')
sys.path.append(r'C:\Program Files (x86)\IronPython 2.7\Lib')

import clr
clr.AddReference('ProtoGeometry')
from Autodesk.DesignScript import Geometry as dg
from System.Net import WebRequest
# EXTENSION Enable ToDSType
clr.AddReference('RevitNodes')
import Revit
clr.ImportExtensions(Revit.Elements)

# Enable Revit Elements
from Revit.Elements import *

# EXTENSION Enable Geometry Conversion Methods
clr.ImportExtensions(Revit.GeometryConversion)

# Enable Revit API
clr.AddReference('RevitAPI')
from Autodesk.Revit.DB import *

# Enable DocumentManager and TransactionManager
clr.AddReference('RevitServices')
from RevitServices.Persistence import DocumentManager
from RevitServices.Transactions import TransactionManager

# Enable ICollection List Translate
clr.AddReference("System")
import System.Collections.Generic
from System.Collections.Generic import List

import urllib2
import base64

import clr
clr.AddReference("RevitAPIUI")
from Autodesk.Revit.UI import TaskDialog

title = "AECedx - Karam"
alert = TaskDialog

scriptsource = "http://synthesize.aecedx.com/Synthesize/Updater"

try:
	response = urllib2.urlopen(scriptsource)
	script = response.read()
except:
	safetogo = False
	OUT = alert.Show(title, "Please Connect to Internet")
	
OUT = script
# ----------------------------------------
python_script_from_string = PythonStringNode(script=python_script)  # IronPython2
