# Dynamo graph Analyse.Basic Curve Length.dyn (Dynamo 2.13.1.3887)
# author: karam@aecedx.com
# packages: Synthesize toolkit 12.5.1

# group: Input
n01_select_curves = DSModelElementsSelection()  # "01.Select Curves"; nothing selected; graph input
n02_rounding_precision = DoubleInput(0.01)  # "02.Rounding Precision"; graph input

curves = Element.Curves(element=n01_select_curves)
flatten = List.Flatten(list=curves)
length = Curve.Length(curve=flatten)
roundToPrecision = Custom[CW.Math.RoundToPrecision](VARdbl=length, VARprecision=n02_rounding_precision)  # package Synthesize toolkit; Rounds a number to a specified precision
as_polycurve_bycurves_with = Custom[AS.[&] PolyCurve.ByCurves With Failures](VARcurves=flatten)  # package Synthesize toolkit; Create polycurves from an unordered list of curves.
flatten_2 = List.Flatten(list=as_polycurve_bycurves_with.VARpolyCurve)
length_2 = Curve.Length(curve=flatten_2)
roundToPrecision_2 = Custom[CW.Math.RoundToPrecision](VARdbl=length_2, VARprecision=n02_rounding_precision)
sum = Math.Sum(values=length)
roundToPrecision_3 = Custom[CW.Math.RoundToPrecision](VARdbl=sum, VARprecision=n02_rounding_precision)

# group: Report
n01_curves_lengths = Watch(roundToPrecision)  # "01.Curves Lengths"; graph output
n02_connected_curves_lengths = Watch(roundToPrecision_2)  # "02.Connected Curves Lengths"; graph output
n03_total_length = Watch(roundToPrecision_3)  # "03.Total Length"; graph output

debug_python_no_message = Custom[Debug Python No Message]()  # package Synthesize toolkit; Debug Python
