# Dynamo graph Analyse.Basic Solid Volume.dyn (Dynamo 2.13.1.3887)
# author: karam@aecedx.com
# packages: Synthesize toolkit 12.5.1

# group: Input
n01_select_solids = DSModelElementsSelection()  # "01.Select Solids"; nothing selected; graph input
n02_rounding_precision = DoubleInput(0.01)  # "02.Rounding Precision"; graph input

element_geometry_fixer = Custom[Element.Geometry Fixer](VARElement=n01_select_solids)  # package Synthesize toolkit; Element.Geometry Fixer
code_block = CodeBlock { "Solid"; }
byClassName = Custom[SP.Filter.ByClassName](VARobject=element_geometry_fixer, VARclassName=code_block)  # package Synthesize toolkit; Filters a list of objects by the object's class name. Note that Dynamo elements belong to different classes than their Revit counterparts. Use the Object.Class node to check an object's class.
isEmpty = List.IsEmpty(list=byClassName.VARin, lacing=Longest)
filterByBoolMask = List.FilterByBoolMask(list=byClassName.VARin, mask=isEmpty)
volume = Solid.Volume(solid=filterByBoolMask.out)
sum = Math.Sum(values=volume@L2)
roundToPrecision = Custom[CW.Math.RoundToPrecision](VARdbl=sum, VARprecision=n02_rounding_precision)  # package Synthesize toolkit; Rounds a number to a specified precision
sum_2 = Math.Sum(values=sum)
roundToPrecision_2 = Custom[CW.Math.RoundToPrecision](VARdbl=sum_2, VARprecision=n02_rounding_precision)
filterByBoolMask_2 = List.FilterByBoolMask(list=n01_select_solids, mask=isEmpty)

# group: Report
n01_solids_volumes = Watch(roundToPrecision)  # "01.Solids Volumes"; graph output
n02_total_volume = Watch(roundToPrecision_2)  # "02.Total Volume"; graph output
elements = Watch(filterByBoolMask_2.out)  # "03.Elements"; graph output

debug_python = Custom[Debug Python]()  # package Synthesize toolkit; Debug Python
