# Dynamo graph Analyse.Building View Analysis By All Elements of Active View.dyn (Dynamo 2.13.1.3887)
# author: karam@aecedx.com
# packages: Synthesize toolkit 12.5.1

# note: Report

# group: Input - Pre Excusion
n05_consider_topography = BoolSelector(false)  # "05.Consider Topography ?"; graph input
# note: Credits : Cesar Escalante
# note: Synthesize toolkit by : Karam Baki
# Website : www.aecedx.com
# E-Mail : karam@aecedx.com
# note: Input
# note: Selection
# note: Excution
# note: Output
n01_select_observer = DSModelElementSelection()  # "01.Select Observer"; nothing selected; graph input
n02_ovserver_height = DoubleSlider(1.8, range=0..100 step 0.1)  # "02.Ovserver Height"; graph input
n04_resolution_less_is_more = IntegerSlider(5, range=1..100 step 1)  # "04.Resolution (Less is more)"; graph input
n03_select_elements_to_check = DSModelElementsSelection()  # "03.Select Elements to Check Their Analysis Status (You May Select Everything)"; nothing selected; graph input

# group: Selection - Temporary Topography Select
categories = Categories("OST_Topography")
all_elements_of_category = ElementsOfCategory(Category=categories)
code_block = CodeBlock { null; }
scopeIf = ScopedIf(test=n05_consider_topography, true=all_elements_of_category, false=code_block)
code_block_2 = CodeBlock { false; }
clean = List.Clean(list=scopeIf, preserveIndices=code_block_2)
polySurface = Custom[ZK.Topography.PolySurface](VARTopography=clean)  # package Synthesize toolkit; Convert topography element to polysurface
python_null_2_empty = Custom[Python Null 2 Empty](VARIN=polySurface.VARPolySurface)  # package Synthesize toolkit; Python Null 2 Empty

# group: Excusion - Generating Temporary Topography
category_of_the_analysis = Categories("OST_Site")  # "Category of the Analysis surfaces"
material_name_of_the_surfaces = StringInput("Default")
byName = Material.ByName(name=material_name_of_the_surfaces)
code_block_3 = CodeBlock { 10000; }
count = List.Count(list=python_null_2_empty)
code_block_4 = CodeBlock { 1; }
sequence = Sequence(start=code_block_3, amount=count, step=code_block_4, lacing=Longest)
string_from_object = FromObject(obj=sequence)
byGeometry = DirectShape.ByGeometry(geometry=python_null_2_empty, category=category_of_the_analysis, material=byName, name=string_from_object)

# group: Selection - Observer
location = FamilyInstance.Location(familyInstance=n01_select_observer)
ZAxis = Vector.ZAxis()
translate = Geometry.Translate(geometry=location, direction=ZAxis, distance=n02_ovserver_height)

# group: Excusion - Spherical Points Generate
byOrigin = CoordinateSystem.ByOrigin(origin=translate)
code_block_5 = CodeBlock(res=n04_resolution_less_is_more) { 1..180..res; }
code_block_6 = CodeBlock(res=n04_resolution_less_is_more) { 0..360..res; }
dropLastItem = Custom[CW.List.DropLastItem](VARlist=code_block_6)  # package Synthesize toolkit; Drops the last item from a given list.
number = DoubleInput(10)
bySphericalCoordinates = Point.BySphericalCoordinates(coordinateSystem=byOrigin, phi=code_block_5, theta=dropLastItem, radius=number, lacing=CrossProduct)
flatten = List.Flatten(list=bySphericalCoordinates)

# group: Excusion - Ray and Bouncing Objects
byTwoPoints = Vector.ByTwoPoints(start=translate, end=flatten, lacing=Longest)
code_block_7 = CodeBlock { 1; }
hot_get_revit_activeview = Custom[HOT.Get Revit ActiveView]()  # package Synthesize toolkit; Active View
byOriginDirection = Revit.References.RayBounce.ByOriginDirection(origin=translate, direction=byTwoPoints, maxBounces=code_block_7, view=hot_get_revit_activeview, lacing=Longest)
isEmpty = List.IsEmpty(list=byOriginDirection.elements@L2)
filterByBoolMask = List.FilterByBoolMask(list=byOriginDirection.points, mask=isEmpty)
filterByBoolMask_2 = List.FilterByBoolMask(list=byOriginDirection.elements, mask=isEmpty)
flatten_2 = List.Flatten(list=filterByBoolMask_2.out)

# group: Excusion - Deleting Temporary Topography
passthrough = Custom[CW.Passthrough](VARpassThrough=byGeometry, VARwaitFor=byOriginDirection.points)  # package Synthesize toolkit; Forces a sequential order of execution. The node wired into the output of the Passthrough node will be executed *after* the node wired into the waitFor input (e.g. important for some Revit operations). The value of the passThrough input will be passed on to the node wired into the output port of the Passthrough node.
eraser = Custom[ST.Tool.Eraser](VARList=passthrough)  # package Synthesize toolkit; Try to delete any element from project

# group: Excustion - Filter Rays by Selected Building
lastItem = List.LastItem(list=filterByBoolMask.out@L2)
flatten_3 = List.Flatten(list=lastItem)
id = Element.Id(element=flatten_2)
groupByKey = List.GroupByKey(list=flatten_3, keys=id)
id_2 = Element.Id(element=n03_select_elements_to_check)
allIndicesOf = List.AllIndicesOf(list=groupByKey.uniqueKeys, item=id_2)
flatten_4 = List.Flatten(list=allIndicesOf)
getItemAtIndex = List.GetItemAtIndex(list=groupByKey.groups, index=flatten_4)

# group: Excusion - Point Analysis
hot_get_revit_activeview_2 = Custom[HOT.Get Revit ActiveView]()
flatten_5 = List.Flatten(list=getItemAtIndex)
byStartPointEndPoint = Line.ByStartPointEndPoint(startPoint=translate, endPoint=getItemAtIndex)
length = Curve.Length(curve=byStartPointEndPoint)
flatten_6 = List.Flatten(list=length)
flatten_7 = List.Flatten(list=flatten_6)
unit_types = UnitTypes("Length")

# group: Output - Analysis Display
byViewPointsAndValues = Revit.AnalysisDisplay.PointAnalysisDisplay.ByViewPointsAndValues(view=hot_get_revit_activeview_2, sampleLocations=flatten_5, samples=flatten_7, unitType=unit_types)

# group: Report - Popup Message
isNull = Object.IsNull(object=byViewPointsAndValues)
code_block_8 = CodeBlock { "None of the selected elements are visible, or error in inputs"; }
empty = List.Empty()
scopeIf_2 = ScopedIf(test=isNull, true=code_block_8, false=empty)
alert_popup = Custom[Alert Popup](VARMessage=scopeIf_2)  # package Synthesize toolkit; Popup a message dialog in Revit

debug_python = Custom[Debug Python]()  # package Synthesize toolkit; Debug Python
