# Dynamo graph Analyse.Building View Analysis By Surface Selection.dyn (Dynamo 2.13.1.3887)
# author: karam@aecedx.com
# packages: Synthesize toolkit 12.5.1

# note: Report

# group: Input - Pre Excusion
n06_consider_topography = BoolSelector(false)  # "06.Consider Topography ?"; graph input
# note: Output
# note: Excution
# note: Synthesize toolkit by : Karam Baki
# Website : www.aecedx.com
# E-Mail : karam@aecedx.com
# note: Credits : Cesar Escalante
# note: Selection
# note: Input
n01_select_observer = DSModelElementSelection()  # "01.Select Observer"; nothing selected; graph input
n02_ovserver_height = DoubleSlider(1.8, range=0..100 step 0.1)  # "02.Ovserver Height"; graph input
n04_u_density = DoubleInput(5)  # "04.U Density"; graph input
n05_v_density = DoubleInput(5)  # "05.V Density"; graph input
n03_maximum_bounces = DoubleInput(1)  # "03.Maximum Bounces"; graph input

# group: Selection - Temporary Topography Select
categories = Categories("OST_Topography")
all_elements_of_category = ElementsOfCategory(Category=categories)
code_block = CodeBlock { null; }
scopeIf = ScopedIf(test=n06_consider_topography, true=all_elements_of_category, false=code_block)
code_block_2 = CodeBlock { false; }
clean = List.Clean(list=scopeIf, preserveIndices=code_block_2)
polySurface = Custom[ZK.Topography.PolySurface](VARTopography=clean)  # package Synthesize toolkit; Convert topography element to polysurface
python_null_2_empty = Custom[Python Null 2 Empty](VARIN=polySurface.VARPolySurface)  # package Synthesize toolkit; Python Null 2 Empty

# group: Excusion - Generating Temporary Topography
category_of_the_analysis = Categories("OST_Site")  # "Category of the Analysis surfaces"
material_name_of_the_surfaces = StringInput("Default")
byName = Material.ByName(name=material_name_of_the_surfaces)
code_block_3 = CodeBlock { 10000; }
count = List.Count(list=python_null_2_empty)
code_block_4 = CodeBlock { 1; }
sequence = Sequence(start=code_block_3, amount=count, step=code_block_4, lacing=Longest)
string_from_object = FromObject(obj=sequence)
byGeometry = DirectShape.ByGeometry(geometry=python_null_2_empty, category=category_of_the_analysis, material=byName, name=string_from_object)

# group: Selection - Observer
location = FamilyInstance.Location(familyInstance=n01_select_observer)
ZAxis = Vector.ZAxis()
translate = Geometry.Translate(geometry=location, direction=ZAxis, distance=n02_ovserver_height)

# group: Input - Post Excusion
code_block_5 = CodeBlock { "Select Surfaces and Click Finish"; }
alert_popup = Custom[Alert Popup](VARMessage=code_block_5)  # package Synthesize toolkit; Popup a message dialog in Revit
selectFaces = Custom[SP.SelectFaces+](VARrefresh=alert_popup)  # package Synthesize toolkit; Select multiple faces from inside the Revit UI. Be sure to press "Finish" once done. Unlike the built-in node, face references of instances will be added sucessfully and you'l get the pick points. You can use a Boolean toggle to refresh your selection.

# group: Excusion - Selected Surfaces UV Points Generate
toNurbsSurface = Surface.ToNurbsSurface(surface=selectFaces.VARfaces)
code_block_6 = CodeBlock { false; }
code_block_7 = CodeBlock { true; }
byNurbsSurfaceUniform = TSpline.TSplineSurface.ByNurbsSurfaceUniform(nurbsSurface=toNurbsSurface, uSpans=n04_u_density, vSpans=n05_v_density, uUseArcLen=code_block_6, vUseArcLen=code_block_6, inSmoothMode=code_block_7)
vertices = Topology.Vertices(topology=byNurbsSurfaceUniform)
pointGeometry = Vertex.PointGeometry(vertex=vertices)

# group: Excusion - Points Filtering
doesIntersect = Geometry.DoesIntersect(geometry=selectFaces.VARfaces, other=pointGeometry)
filterByBoolMask = List.FilterByBoolMask(list=pointGeometry, mask=doesIntersect)

# group: Excusion - Ray and Bouncing Objects
flatten = List.Flatten(list=filterByBoolMask.in)
byTwoPoints = Vector.ByTwoPoints(start=translate, end=flatten, lacing=Longest)
hot_get_revit_activeview = Custom[HOT.Get Revit ActiveView]()  # package Synthesize toolkit; Active View
byOriginDirection = Revit.References.RayBounce.ByOriginDirection(origin=translate, direction=byTwoPoints, maxBounces=n03_maximum_bounces, view=hot_get_revit_activeview, lacing=Longest)

# group: Excusion - Deleting Temporary Topography
passthrough = Custom[CW.Passthrough](VARpassThrough=byGeometry, VARwaitFor=byOriginDirection.points)  # package Synthesize toolkit; Forces a sequential order of execution. The node wired into the output of the Passthrough node will be executed *after* the node wired into the waitFor input (e.g. important for some Revit operations). The value of the passThrough input will be passed on to the node wired into the output port of the Passthrough node.
eraser = Custom[ST.Tool.Eraser](VARList=passthrough)  # package Synthesize toolkit; Try to delete any element from project

# group: Excusion - Point Analysis
hot_get_revit_activeview_2 = Custom[HOT.Get Revit ActiveView]()
restOfItems = List.RestOfItems(list=byOriginDirection.points@L2)
flatten_2 = List.Flatten(list=restOfItems)
flatten_3 = List.Flatten(list=flatten_2)
byStartPointEndPoint = Line.ByStartPointEndPoint(startPoint=translate, endPoint=flatten_2)
length = Curve.Length(curve=byStartPointEndPoint)
flatten_4 = List.Flatten(list=length)
flatten_5 = List.Flatten(list=flatten_4)
unit_types = UnitTypes("Length")

# group: Output Analysis Display
byViewPointsAndValues = Revit.AnalysisDisplay.PointAnalysisDisplay.ByViewPointsAndValues(view=hot_get_revit_activeview_2, sampleLocations=flatten_3, samples=flatten_5, unitType=unit_types)

# group: Report - Popup Message
isNull = Object.IsNull(object=byViewPointsAndValues)
code_block_8 = CodeBlock { "Nothing visible on the way to surface, or error in inputs"; }
empty = List.Empty()
scopeIf_2 = ScopedIf(test=isNull, true=code_block_8, false=empty)
alert_popup_2 = Custom[Alert Popup](VARMessage=scopeIf_2)

debug_python = Custom[Debug Python]()  # package Synthesize toolkit; Debug Python
