# Dynamo graph Analyse.Clearance Height above Stairs Analysis.dyn (Dynamo 2.13.1.3887)
# author: karam@aecedx.com
# packages: Synthesize toolkit 12.5.1

# group: Input
# note: Select the stair object
n02_select_stair_to_analyse = DSModelElementSelection()  # "02.Select Stair to Analyse"; nothing selected; graph input
# note: Use this offset value to set the calculation point outside the tread solid geometry.
n03_safety_offset_from_stair = DoubleInput(0.005)  # "03.Safety Offset from Stair Tread"; graph input
# note: Set the minimal clearance height above the stair treads.
n04_minimum_clearance_height = DoubleInput(2)  # "04.Minimum Clearance Height"; graph input

# group: Detection of the topsurface of each tread and landing
faces = Element.Faces(element=n02_select_stair_to_analyse)
code_block = CodeBlock { 0.5; }
# note: Get the Z-value of the normal vector of each surface of the stair solid.
normalAtParameter = Surface.NormalAtParameter(surface=faces, u=code_block, v=code_block)
Z = Vector.Z(vector=normalAtParameter)
code_block_2 = CodeBlock { 1; }
eq = Z == code_block_2
# note: Filter surfaces on basis of the Z-valu of the normal vector. Surfaces where the Z-component = 1 (vector pointing upwards) represent the landings, treads and top of supports.
filterByBoolMask = List.FilterByBoolMask(list=faces, mask=eq)
code_block_3 = CodeBlock(a=filterByBoolMask.in) { a; }
area = Surface.Area(surface=filterByBoolMask.in)
code_block_4 = CodeBlock { "Actual Tread Depth"; "Actual Run Width"; }
# note: Get the dimensions of the treads and calculate the surface of one tread
getParameterValueByName = Element.GetParameterValueByName(element=n02_select_stair_to_analyse, parameterName=code_block_4.out0)
getParameterValueByName_2 = Element.GetParameterValueByName(element=n02_select_stair_to_analyse, parameterName=code_block_4.out1)
code_block_5 = CodeBlock(d=getParameterValueByName, w=getParameterValueByName_2)
# ---------- code_block_5.designscript (2 lines) ----------
//Surface of one tread
A=d*w;
# ----------------------------------------
ge = area >= code_block_5
# note: Filter the surfaces that are smaller than the surface of one tread (these are mainly the surfaces of risers and supports).
filterByBoolMask_2 = List.FilterByBoolMask(list=filterByBoolMask.in, mask=ge)
code_block_6 = CodeBlock(TopSurfaces=filterByBoolMask_2.in)
# ---------- code_block_6.designscript (3 lines) ----------
//Results in top surfaces of
//treads and landings
TopSurfaces;
# ----------------------------------------

# group: Ray Casting in Dynamo
code_block_7 = CodeBlock { 0.5; }
# note: Get the centerpoint of each tread top surface
pointAtParameter = Surface.PointAtParameter(surface=code_block_6, u=code_block_7, v=code_block_7)
ZAxis = Vector.ZAxis()
code_block_8 = CodeBlock(SafetyOffset=n03_safety_offset_from_stair) { SafetyOffset; }
# note: Create a calculation point by vertically translating the centerpoint with a safety distance to avoid the point being inside the tread geometry.
translate = Geometry.Translate(geometry=pointAtParameter, direction=ZAxis, distance=code_block_8)
ZAxis_2 = Vector.ZAxis()
code_block_9 = CodeBlock { 1; }
hot_get_revit_activeview = Custom[HOT.Get Revit ActiveView]()  # package Synthesize toolkit; Active View
# note: Use ray bounce to detect elements hitted in upward direction and return the hitpoint and the Revit element.
byOriginDirection = Revit.References.RayBounce.ByOriginDirection(origin=translate, direction=ZAxis_2, maxBounces=code_block_9, view=hot_get_revit_activeview, lacing=Longest)
code_block_10 = CodeBlock(a=byOriginDirection.points) { a; }

count = List.Count(list=byOriginDirection.points@L2)
code_block_11 = CodeBlock { 2; }
eq_2 = count == code_block_11

# group (continued): Ray Casting in Dynamo
# note: Filter out the results of rays that are not bouncing, and thus result only one point (which is the originator)
filterByBoolMask_3 = List.FilterByBoolMask(list=byOriginDirection.points, mask=eq_2)
# note: Create the ray bounce lines from the resulting points.
byPoints = PolyCurve.ByPoints(points=filterByBoolMask_3.in)

# group: Clearance Height Requirement
length = Curve.Length(curve=byPoints)
# note: Add the security offset to have the correct distance again.
add = length + n03_safety_offset_from_stair
code_block_12 = CodeBlock(MinClearanceHeight=n04_minimum_clearance_height) { MinClearanceHeight; }
lt = add < code_block_12

# group: Creation of rays in Revit
explode = Geometry.Explode(geometry=byPoints)
# note: Explode the polycurve the a single line, in order to create a model line in Revit.
flatten = List.Flatten(list=explode)
byCurve = ModelCurve.ByCurve(curve=flatten)
code_block_13 = CodeBlock { "Line Style"; }
n01_linestyle_to_use = StringInput("Wide Lines")  # "01.Linestyle to Use"; graph input
# note: From the Archi-lab / Grimshaw package
al_get_line_style_by_name = Custom[AL.Get Line Style by Name](VARName=n01_linestyle_to_use)  # package Synthesize toolkit; This node will return a line style object by its name. Line styles can be either Drafting or Model Line Property.
# note: [Optional]
# Change the linestyle of the model line in Revit.
setParameterByName = Element.SetParameterByName(element=byCurve, parameterName=code_block_13, value=al_get_line_style_by_name)

# group: Visualization of the rays in Revit and Dynamo Thanks to Dieter (Autodesk)
# note: Filter the ray bounce lines in Dynamo, based on the clearance height criteria, and change their appearance in the Dynamo canvas.
filterByBoolMask_4 = List.FilterByBoolMask(list=byPoints, mask=lt)
code_block_14 = CodeBlock()
# ---------- code_block_14.designscript (5 lines) ----------
//Red
a=255;
r=255;
g=0;
b=0;
# ----------------------------------------
byARGB = Color.ByARGB(alpha=code_block_14.a, red=code_block_14.r, green=code_block_14.g, blue=code_block_14.b)
byGeometryColor = Modifiers.GeometryColor.ByGeometryColor(geometry=filterByBoolMask_4.in, color=byARGB)
code_block_15 = CodeBlock()
# ---------- code_block_15.designscript (5 lines) ----------
//Green
a=255;
r=0;
g=255;
b=0;
# ----------------------------------------
byARGB_2 = Color.ByARGB(alpha=code_block_15.a, red=code_block_15.r, green=code_block_15.g, blue=code_block_15.b)
# note: Lines that do NOT meet the requirements.
# note: Lines that meet the requirements.
byGeometryColor_2 = Modifiers.GeometryColor.ByGeometryColor(geometry=filterByBoolMask_4.out, color=byARGB_2)
# note: Filter the model lines in Revit, based on the clearance height criteria, and change their appearance in the current Revit view.
filterByBoolMask_5 = List.FilterByBoolMask(list=setParameterByName, mask=lt)
overrideColorInView = Element.OverrideColorInView(element=filterByBoolMask_5.in, color=byARGB)
overrideColorInView_2 = Element.OverrideColorInView(element=filterByBoolMask_5.out, color=byARGB_2)

debug_python = Custom[Debug Python]()  # package Synthesize toolkit; Debug Python
