# Dynamo graph Analyse.Golden Ratio By Length.dyn (Dynamo 2.13.1.3887)
# author: karam@aecedx.com
# packages: Synthesize toolkit 12.5.1

# group: Input PreExcusion
# note: Selection
# note: Excution
# note: Output
# note: Created by : Karam Baki
# Website : www.aecedx.com
# E-Mail : karam@aecedx.com
# note: Input
n01_long_length = DoubleInput(0)  # "01.Long Length"; graph input
n02_short_length = DoubleInput(0)  # "02.Short Length"; graph input
n03_whole_length = DoubleInput(0)  # "03.Whole Length"; graph input

# group: Excution - Long Length
code_block = CodeBlock { 0; }
eq = n01_long_length == code_block
# note: Report
code_block_2 = CodeBlock { 1.6180348722245; }
div = n01_long_length / code_block_2
add = n01_long_length + div

# group: Excution - Short Length
code_block_3 = CodeBlock { 0; }
eq_2 = n02_short_length == code_block_3
code_block_4 = CodeBlock { 1.6180348722245; }
mul = n02_short_length * code_block_4
add_2 = n02_short_length + mul

# group: Excution - Whole Length
code_block_5 = CodeBlock { 0; }
eq_3 = n03_whole_length == code_block_5
div_2 = n03_whole_length / code_block_4
sub = n03_whole_length - div_2

# group: Excution - Filtering Zero Inputs
code_block_6 = CodeBlock { "Inactive"; }
scopeIf = Custom[CW.ScopeIf+](VARtest=eq, VARtrue=code_block_6, VARfalse=div)  # package Synthesize toolkit; A (hopefully) more robust implementation of ScopeIf. Tests a single boolean and returns a value accordingly.
scopeIf_2 = Custom[CW.ScopeIf+](VARtest=eq, VARtrue=code_block_6, VARfalse=add)
scopeIf_3 = Custom[CW.ScopeIf+](VARtest=eq_2, VARtrue=code_block_6, VARfalse=mul)
scopeIf_4 = Custom[CW.ScopeIf+](VARtest=eq_2, VARtrue=code_block_6, VARfalse=add_2)
scopeIf_5 = Custom[CW.ScopeIf+](VARtest=eq_3, VARtrue=code_block_6, VARfalse=sub)
scopeIf_6 = Custom[CW.ScopeIf+](VARtest=eq_3, VARtrue=code_block_6, VARfalse=div_2)

# group: Report
n01_get_short_by_long_length = Watch(scopeIf)  # "01.Get Short By Long Length"; graph output
n02_get_total_by_long_length = Watch(scopeIf_2)  # "02.Get Total By Long Length"; graph output
n03_get_long_by_short_length = Watch(scopeIf_3)  # "03.Get Long By Short Length"; graph output
n04_get_total_by_short_length = Watch(scopeIf_4)  # "04.Get Total By Short Length"; graph output
n05_get_short_by_whole_length = Watch(scopeIf_5)  # "05.Get Short By Whole Length"; graph output
n06_get_long_by_whole_length = Watch(scopeIf_6)  # "06.Get Long By Whole Length"; graph output

debug_python = Custom[Debug Python]()  # package Synthesize toolkit; Debug Python
