# Dynamo graph Analyse.K-Clash 2 Views Generate.dyn (Dynamo 2.13.1.3887)
# author: karam@aecedx.com
# packages: Synthesize toolkit 12.5.1

code_block = CodeBlock { null; 2; }

# group: Input
n01_interference_family_name = StringInput("KClash_Interference Family")  # "01.Interference Family Name"; graph input
n02_cleanup_redundant_views_along = BoolSelector(true)  # "02.Cleanup Redundant Views Along The Way"; graph input
n03_kclash_views_prefix = StringInput("KClash")  # "03.KClash Views Prefix"; graph input
n04_generate_3d_views_for_fixed = BoolSelector(false)  # "04.Generate 3D Views for Fixed Clashes ?"; graph input
n05_first_element_mark_parameter = StringInput("Mark")  # "05.First Element Mark Parameter"; graph input
n06_second_element_mark_parameter = StringInput("Mark")  # "06.Second Element Mark Parameter"; graph input

k_clash = Custom[K-Clash](VARFilePath=code_block.out0, VARInterferenceFamily=n01_interference_family_name, VARMode1NewMarkers2NewViews3CleanupMarkers4CleanupViews5Cleanupall=code_block.out1, VARCleanupalongtheway=n02_cleanup_redundant_views_along, VARKClashViewsPrefix=n03_kclash_views_prefix, VARGenerate3DViewsforFixedClashes=n04_generate_3d_views_for_fixed, VARFirstElementMarkParameter=n05_first_element_mark_parameter, VARSecondElementMarkParameter=n06_second_element_mark_parameter)  # package Synthesize toolkit; K-Clash
debug_python_no_message = Custom[Debug Python No Message]()  # package Synthesize toolkit; Debug Python
