# Dynamo graph Analyse.K-Clash 3 Cleanup.dyn (Dynamo 2.13.1.3887)
# author: karam@aecedx.com
# packages: Synthesize toolkit 12.5.1

code_block = CodeBlock { null; }

# group: Input
n01_interference_family_name = StringInput("KClash_Interference Family")  # "01.Interference Family Name"; graph input
n02_cleanup_redundant_markers = BoolSelector(true)  # "02.Cleanup Redundant Markers"; graph input
n03_cleanup_redundant_views = BoolSelector(true)  # "03.Cleanup Redundant Views"; graph input

python_script = Python(IN[0]=n02_cleanup_redundant_markers, IN[1]=n03_cleanup_redundant_views)  # IronPython2
# ---------- python_script.python (17 lines) ----------
import clr
clr.AddReference('ProtoGeometry')
from Autodesk.DesignScript.Geometry import *
#The inputs to this node will be stored as a list in the IN variables.
dataEnteringNode = IN

cleanupMarkers = IN[0]
cleanupViews = IN[1]

if cleanupMarkers and cleanupViews:
	OUT = 5
elif cleanupMarkers:
	OUT = 3
elif cleanupViews:
	OUT = 4
else:
	OUT = 0
# ----------------------------------------
k_clash = Custom[K-Clash](VARFilePath=code_block, VARInterferenceFamily=n01_interference_family_name, VARMode1NewMarkers2NewViews3CleanupMarkers4CleanupViews5Cleanupall=python_script)  # package Synthesize toolkit; K-Clash
debug_python_no_message = Custom[Debug Python No Message]()  # package Synthesize toolkit; Debug Python
