# Dynamo graph Analyse.Path Analysis (No Projection).dyn (Dynamo 2.13.1.3887)
# author: karam@aecedx.com
# packages: Synthesize toolkit 12.5.1

hot_get_revit_activeview = Custom[HOT.Get Revit ActiveView]()  # package Synthesize toolkit; Active View

# group: Input
n06_force_end = BoolSelector(false)  # "06.Force End ?"; graph input
n04_offset_closed_loops = DoubleInput(0)  # "04.Offset (Closed Loops Recommended)"; graph input
n08_flip_direction = BoolSelector(false)  # "08.Flip Direction"; graph input
n01_model_lines_false_detail = BoolSelector(true)  # "01.Model Lines = False | Detail Lines = True"; graph input
n02_linestyle_to_analyse = StringInput("Thin Lines")  # "02.Linestyle to Analyse"; graph input
n05_start_offset = DoubleInput(0)  # "05.Start Offset"; graph input
n07_least_circles_possible_fasle = BoolSelector(true)  # "07.Least Circles Possible = Fasle | Most Circles Possible = True"; graph input
n03_resolution_distance_between = DoubleInput(5)  # "03.Resolution (Distance between Points)"; graph input
n09_title_of_the_analysis = StringInput("Path Analysis")  # "09.Title of the Analysis"; graph input
n10_description_of_the_anaylsis = StringInput("Just a test")  # "10.Description of the Anaylsis"; graph input

code_block = CodeBlock { null; false; }
code_block_2 = CodeBlock { 0; }
eq = n04_offset_closed_loops == code_block_2
code_block_3 = CodeBlock { null; }
default_linestyles_name_revit = Custom[Default Linestyles Name Revit Compatiblity](VARLinestylename=n02_linestyle_to_analyse)  # package Synthesize toolkit; Default Linestyles Name Revit Compatiblity
al_select_model_lines_by_style = Custom[AL.Select Model Lines by Style](VARStyleName=default_linestyles_name_revit)  # package Synthesize toolkit; This node will select all model lines in the revit project by a line style name.
scopeIf = Custom[CW.ScopeIf+](VARtest=n01_model_lines_false_detail, VARtrue=code_block_3, VARfalse=al_select_model_lines_by_style)  # package Synthesize toolkit; A (hopefully) more robust implementation of ScopeIf. Tests a single boolean and returns a value accordingly.
al_select_detail_lines_by_style = Custom[AL.Select Detail Lines by Style](VARStyleName=default_linestyles_name_revit)  # package Synthesize toolkit; This node will select all model lines in the revit project by a line style name.
scopeIf_2 = Custom[CW.ScopeIf+](VARtest=n01_model_lines_false_detail, VARtrue=al_select_detail_lines_by_style, VARfalse=code_block_3)
create = List.Create(item0=scopeIf, item1=scopeIf_2)
flatten = List.Flatten(list=create)
code_block_4 = CodeBlock { false; }
clean = List.Clean(list=flatten, preserveIndices=code_block_4)
curve = CurveElement.Curve()  # unwired: curveElement
map = List.Map(list=clean, f_x=curve)
code_block_5 = CodeBlock { false; }
clean_2 = List.Clean(list=map, preserveIndices=code_block_5)
flatten_2 = List.Flatten(list=clean_2)
as_polycurve_bycurves = Custom[AS.[&] PolyCurve.ByCurves](VARcurves=flatten_2)  # package Synthesize toolkit; Create polycurves from an unordered list of curves.
reverse = Curve.Reverse(curve=as_polycurve_bycurves.VARpolyCurve)
scopeIf_3 = Custom[CW.ScopeIf+](VARtest=n08_flip_direction, VARtrue=reverse, VARfalse=as_polycurve_bycurves.VARpolyCurve)
offset = Curve.Offset(distance=n04_offset_closed_loops)  # unwired: curve
map_2 = List.Map(list=scopeIf_3, f_x=offset)
scopeIf_4 = Custom[CW.ScopeIf+](VARtest=eq, VARtrue=scopeIf_3, VARfalse=map_2)
flatten_3 = List.Flatten(list=scopeIf_4)
length = Curve.Length(curve=flatten_3)
sub = length - n05_start_offset
div = sub / n03_resolution_distance_between
ceiling = Math.Ceiling(number=div)
floor = Math.Floor(number=div)
scopeIf_5 = Custom[CW.ScopeIf+](VARtest=n07_least_circles_possible_fasle, VARtrue=ceiling, VARfalse=floor)
code_block_6 = CodeBlock { 1; }
code_block_7 = CodeBlock { 0; }
eq_2 = _ == code_block_7  # unwired: x
replaceByCondition = Replace(item=scopeIf_5, replaceWith=code_block_6, condition=eq_2)
sequence = Sequence(start=n05_start_offset, amount=replaceByCondition, step=n03_resolution_distance_between, lacing=Longest)
pointAtSegmentLength = Curve.PointAtSegmentLength(curve=flatten_3, segmentLength=sequence)
code_block_8 = CodeBlock { false; }
clean_3 = List.Clean(list=pointAtSegmentLength, preserveIndices=code_block_8)
scopeIf_6 = Custom[CW.ScopeIf+](VARtest=n06_force_end, VARtrue=code_block.out0, VARfalse=clean_3)
join = List.Join()  # unwired: list0, list1
endPoint = Curve.EndPoint(curve=flatten_3)
combine = List.Combine(comb=join, list1=clean_3, list2=endPoint)
scopeIf_7 = Custom[CW.ScopeIf+](VARtest=n06_force_end, VARtrue=combine, VARfalse=code_block.out0)
create_2 = List.Create(item0=scopeIf_6, item1=scopeIf_7)
clean_4 = List.Clean(list=create_2, preserveIndices=code_block.out1)
flatten_4 = List.Flatten(list=clean_4@L2)
pruneDuplicates = Point.PruneDuplicates(points=flatten_4)
code_block_9 = CodeBlock { false; }
clean_5 = List.Clean(list=pruneDuplicates, preserveIndices=code_block_9)
flatten_5 = List.Flatten(list=clean_5)
flatten_6 = List.Flatten(list=flatten_5@L2)
flatten_7 = List.Flatten(list=scopeIf_4)
parameterAtPoint = Curve.ParameterAtPoint(curve=flatten_7, point=pruneDuplicates)
segmentLengthAtParameter = Curve.SegmentLengthAtParameter(curve=flatten_7, parameter=parameterAtPoint)
code_block_10 = CodeBlock { false; }
clean_6 = List.Clean(list=segmentLengthAtParameter, preserveIndices=code_block_10)
flatten_8 = List.Flatten(list=clean_6)
flatten_9 = List.Flatten(list=flatten_8@L2)
unit_types = UnitTypes("Length")
byViewPointsAndValues = Revit.AnalysisDisplay.PointAnalysisDisplay.ByViewPointsAndValues(view=hot_get_revit_activeview, sampleLocations=flatten_6, samples=flatten_9, name=n09_title_of_the_analysis, description=n10_description_of_the_anaylsis, unitType=unit_types, lacing=Longest)
debug_python = Custom[Debug Python]()  # package Synthesize toolkit; Debug Python
