# Dynamo graph Analyse.Path Analysis (With Projection on Topography).dyn (Dynamo 2.13.1.3887)
# author: karam@aecedx.com
# packages: Synthesize toolkit 12.5.1

hot_get_revit_activeview = Custom[HOT.Get Revit ActiveView]()  # package Synthesize toolkit; Active View

# group: Input
n09_force_end = BoolSelector(false)  # "09.Force End ?"; graph input
n07_offset_closed_loops = DoubleInput(0)  # "07.Offset (Closed Loops Recommended)"; graph input
n11_flip_direction_lines_on = BoolSelector(false)  # "11.Flip Direction (Lines on Building & Topography)"; graph input
n04_model_lines_false_detail = BoolSelector(false)  # "04.Model Lines = False | Detail Lines = True (on Building Elements)"; graph input
n05_linestyle_to_analyse_on = StringInput("Thin Lines")  # "05.Linestyle to Analyse (on Building Elements)"; graph input
n12_flip_direction_lines_on = BoolSelector(false)  # "12.Flip Direction (Lines on Topography Only)"; graph input
n01_select_topography = DSModelElementSelection()  # "01.Select Topography"; nothing selected; graph input
n02_model_lines_false_detail = BoolSelector(false)  # "02.Model Lines = False | Detail Lines = True (on Topography)"; graph input
n03_linestyle_to_analyse_on = StringInput("Wide Lines")  # "03.Linestyle to Analyse (on Topography)"; graph input
n08_start_offset = DoubleInput(0)  # "08.Start Offset"; graph input
n10_least_circles_possible_fasle = BoolSelector(true)  # "10.Least Circles Possible = Fasle | Most Circles Possible = True"; graph input
n06_resolution_distance_between = DoubleInput(2)  # "06.Resolution (Distance between Points)"; graph input
n13_title_of_the_analysis = StringInput("Path Analysis")  # "13.Title of the Analysis"; graph input
n14_description_of_the_analsysis = StringInput("Just a Test")  # "14.Description of the Analsysis"; graph input

code_block = CodeBlock { null; false; }
code_block_2 = CodeBlock { 0; }
eq = n07_offset_closed_loops == code_block_2
code_block_3 = CodeBlock { null; }
default_linestyles_name_revit = Custom[Default Linestyles Name Revit Compatiblity](VARLinestylename=n05_linestyle_to_analyse_on)  # package Synthesize toolkit; Default Linestyles Name Revit Compatiblity
al_select_model_lines_by_style = Custom[AL.Select Model Lines by Style](VARStyleName=default_linestyles_name_revit)  # package Synthesize toolkit; This node will select all model lines in the revit project by a line style name.
scopeIf = Custom[CW.ScopeIf+](VARtest=n04_model_lines_false_detail, VARtrue=code_block_3, VARfalse=al_select_model_lines_by_style)  # package Synthesize toolkit; A (hopefully) more robust implementation of ScopeIf. Tests a single boolean and returns a value accordingly.
al_select_detail_lines_by_style = Custom[AL.Select Detail Lines by Style](VARStyleName=default_linestyles_name_revit)  # package Synthesize toolkit; This node will select all model lines in the revit project by a line style name.
scopeIf_2 = Custom[CW.ScopeIf+](VARtest=n04_model_lines_false_detail, VARtrue=al_select_detail_lines_by_style, VARfalse=code_block_3)
create = List.Create(item0=scopeIf, item1=scopeIf_2)
flatten = List.Flatten(list=create)
code_block_4 = CodeBlock { false; }
clean = List.Clean(list=flatten, preserveIndices=code_block_4)
geometry = Element.Geometry(element=clean)
flatten_2 = List.Flatten(list=geometry)
as_polycurve_bycurves = Custom[AS.[&] PolyCurve.ByCurves](VARcurves=flatten_2)  # package Synthesize toolkit; Create polycurves from an unordered list of curves.
polySurface = Custom[ZK.Topography.PolySurface](VARTopography=n01_select_topography)  # package Synthesize toolkit; Convert topography element to polysurface
code_block_5 = CodeBlock { null; }
default_linestyles_name_revit_2 = Custom[Default Linestyles Name Revit Compatiblity](VARLinestylename=n03_linestyle_to_analyse_on)
al_select_model_lines_by_style_2 = Custom[AL.Select Model Lines by Style](VARStyleName=default_linestyles_name_revit_2)
scopeIf_3 = Custom[CW.ScopeIf+](VARtest=n02_model_lines_false_detail, VARtrue=code_block_5, VARfalse=al_select_model_lines_by_style_2)
al_select_detail_lines_by_style_2 = Custom[AL.Select Detail Lines by Style](VARStyleName=default_linestyles_name_revit_2)
scopeIf_4 = Custom[CW.ScopeIf+](VARtest=n02_model_lines_false_detail, VARtrue=al_select_detail_lines_by_style_2, VARfalse=code_block_5)
create_2 = List.Create(item0=scopeIf_3, item1=scopeIf_4)
flatten_3 = List.Flatten(list=create_2)
code_block_6 = CodeBlock { false; }
clean_2 = List.Clean(list=flatten_3, preserveIndices=code_block_6)
geometry_2 = Element.Geometry(element=clean_2)
flatten_4 = List.Flatten(list=geometry_2)
as_polycurve_bycurves_2 = Custom[AS.[&] PolyCurve.ByCurves](VARcurves=flatten_4)
byGeometry = BoundingBox.ByGeometry(geom=polySurface.VARPolySurface)
minPoint = BoundingBox.MinPoint(boundingBox=byGeometry)
Z = Point.Z(point=minPoint)
byCoordinates = Point.ByCoordinates(z=Z)
byOriginNormal = Plane.ByOriginNormal(origin=byCoordinates)
pullOntoPlane = Curve.PullOntoPlane(curve=as_polycurve_bycurves_2.VARpolyCurve, plane=byOriginNormal)
ZAxis = Vector.ZAxis()
maxPoint = BoundingBox.MaxPoint(boundingBox=byGeometry)
Z_2 = Point.Z(point=maxPoint)
sub = Z_2 - Z
extrude = Curve.Extrude(curve=pullOntoPlane, direction=ZAxis, distance=sub)
intersect = Geometry.Intersect(geometry=polySurface.VARPolySurface, other=extrude, lacing=CrossProduct)
code_block_7 = CodeBlock { "Point"; }
byClassName = Custom[SP.Filter.ByClassName](VARobject=intersect, VARclassName=code_block_7)  # package Synthesize toolkit; Filters a list of objects by the object's class name. Note that Dynamo elements belong to different classes than their Revit counterparts. Use the Object.Class node to check an object's class.
code_block_8 = CodeBlock { false; }
clean_3 = List.Clean(list=byClassName.VARout, preserveIndices=code_block_8)
flatten_5 = List.Flatten(list=clean_3)
code_block_9 = CodeBlock { false; }
clean_4 = List.Clean(list=flatten_5, preserveIndices=code_block_9)
as_polycurve_bycurves_3 = Custom[AS.[&] PolyCurve.ByCurves](VARcurves=clean_4)
reverse = Curve.Reverse(curve=as_polycurve_bycurves_3.VARpolyCurve)
scopeIf_5 = Custom[CW.ScopeIf+](VARtest=n12_flip_direction_lines_on, VARtrue=reverse, VARfalse=as_polycurve_bycurves_3.VARpolyCurve)
create_3 = List.Create(item0=as_polycurve_bycurves.VARpolyCurve, item1=scopeIf_5)
flatten_6 = List.Flatten(list=create_3)
code_block_10 = CodeBlock { false; }
clean_5 = List.Clean(list=flatten_6, preserveIndices=code_block_10)
code_block_11 = CodeBlock { false; }
clean_6 = List.Clean(list=clean_5, preserveIndices=code_block_11)
flatten_7 = List.Flatten(list=clean_6)
as_polycurve_bycurves_4 = Custom[AS.[&] PolyCurve.ByCurves](VARcurves=flatten_7)
reverse_2 = Curve.Reverse(curve=as_polycurve_bycurves_4.VARpolyCurve)
scopeIf_6 = Custom[CW.ScopeIf+](VARtest=n11_flip_direction_lines_on, VARtrue=reverse_2, VARfalse=as_polycurve_bycurves_4.VARpolyCurve)
offset = Curve.Offset(distance=n07_offset_closed_loops)  # unwired: curve
map = List.Map(list=scopeIf_6, f_x=offset)
scopeIf_7 = Custom[CW.ScopeIf+](VARtest=eq, VARtrue=scopeIf_6, VARfalse=map)
flatten_8 = List.Flatten(list=scopeIf_7)
length = Curve.Length(curve=flatten_8)
sub_2 = length - n08_start_offset
div = sub_2 / n06_resolution_distance_between
ceiling = Math.Ceiling(number=div)
floor = Math.Floor(number=div)
scopeIf_8 = Custom[CW.ScopeIf+](VARtest=n10_least_circles_possible_fasle, VARtrue=ceiling, VARfalse=floor)
code_block_12 = CodeBlock { 1; }
code_block_13 = CodeBlock { 0; }
eq_2 = _ == code_block_13  # unwired: x
replaceByCondition = Replace(item=scopeIf_8, replaceWith=code_block_12, condition=eq_2)
sequence = Sequence(start=n08_start_offset, amount=replaceByCondition, step=n06_resolution_distance_between, lacing=Longest)
pointAtSegmentLength = Curve.PointAtSegmentLength(curve=flatten_8, segmentLength=sequence)
code_block_14 = CodeBlock { false; }
clean_7 = List.Clean(list=pointAtSegmentLength, preserveIndices=code_block_14)
scopeIf_9 = Custom[CW.ScopeIf+](VARtest=n09_force_end, VARtrue=code_block.out0, VARfalse=clean_7)
join = List.Join()  # unwired: list0, list1
endPoint = Curve.EndPoint(curve=flatten_8)
combine = List.Combine(comb=join, list1=clean_7, list2=endPoint)
scopeIf_10 = Custom[CW.ScopeIf+](VARtest=n09_force_end, VARtrue=combine, VARfalse=code_block.out0)
create_4 = List.Create(item0=scopeIf_9, item1=scopeIf_10)
clean_8 = List.Clean(list=create_4, preserveIndices=code_block.out1)
flatten_9 = List.Flatten(list=clean_8@L2)
pruneDuplicates = Point.PruneDuplicates(points=flatten_9)
code_block_15 = CodeBlock { false; }
clean_9 = List.Clean(list=pruneDuplicates, preserveIndices=code_block_15)
flatten_10 = List.Flatten(list=clean_9)
flatten_11 = List.Flatten(list=flatten_10@L2)
flatten_12 = List.Flatten(list=scopeIf_7)
parameterAtPoint = Curve.ParameterAtPoint(curve=flatten_12, point=pruneDuplicates)
segmentLengthAtParameter = Curve.SegmentLengthAtParameter(curve=flatten_12, parameter=parameterAtPoint)
code_block_16 = CodeBlock { false; }
clean_10 = List.Clean(list=segmentLengthAtParameter, preserveIndices=code_block_16)
flatten_13 = List.Flatten(list=clean_10)
flatten_14 = List.Flatten(list=flatten_13@L2)
unit_types = UnitTypes("Length")
byViewPointsAndValues = Revit.AnalysisDisplay.PointAnalysisDisplay.ByViewPointsAndValues(view=hot_get_revit_activeview, sampleLocations=flatten_11, samples=flatten_14, name=n13_title_of_the_analysis, description=n14_description_of_the_analsysis, unitType=unit_types, lacing=Longest)
code_block_17 = CodeBlock { 0; }
debug_python = Custom[Debug Python]()  # package Synthesize toolkit; Debug Python
