# Dynamo graph Analyse.Sun Path Fit.dyn (Dynamo 2.13.1.3887)
# author: karam@aecedx.com
# packages: Synthesize toolkit 12.5.1

hot_get_revit_activeview = Custom[HOT.Get Revit ActiveView]()  # package Synthesize toolkit; Active View

# group: Input
n01_select_target_model_line = DSModelElementSelection()  # "01.Select Target Model Line"; nothing selected; graph input

temporarilyIsolateInView = Custom[CW.Element.TemporarilyIsolateInView](VARview=hot_get_revit_activeview, VARelement=n01_select_target_model_line)  # package Synthesize toolkit; (Temporarily) isolates elements in the given view
end = Revit.Transaction.Transaction.End(input=temporarilyIsolateInView.VARview)
python_script = Python(IN[0]=end)  # IronPython2
# ---------- python_script.python (25 lines) ----------
import clr

clr.AddReference('RevitServices')
from RevitServices.Persistence import DocumentManager
from RevitServices.Transactions import TransactionManager
clr.AddReference('RevitAPI')
from Autodesk.Revit.DB import *
clr.AddReference('System')
import System

view = UnwrapElement(IN[0])


doc = DocumentManager.Instance.CurrentDBDocument


TransactionManager.Instance.EnsureInTransaction(doc)
view.SunAndShadowSettings.UsesGroundPlane = False
settings_sun = view.SunAndShadowSettings
SunAndShadowSettings.FitToModel(settings_sun)
TransactionManager.Instance.TransactionTaskDone()


#Assign your output to the OUT variable.
OUT = view
# ----------------------------------------
end_2 = Revit.Transaction.Transaction.End(input=python_script)
disableTemporaryHideIsolate = Custom[CW.View.DisableTemporaryHideIsolate](VARview=end_2)  # package Synthesize toolkit; Disables the temporary hide/isolate for the given view (if set)
debug_python = Custom[Debug Python]()  # package Synthesize toolkit; Debug Python
