# Dynamo graph Analyse.Topo Analysis Extend.dyn (Dynamo 2.13.1.3887)
# author: karam@aecedx.com
# packages: Synthesize toolkit 12.5.1

debug_python_no_message = Custom[Debug Python No Message]()  # package Synthesize toolkit; Debug Python
hot_get_all_filter = Custom[HOT.Get All Filter]()  # package Synthesize toolkit; Get all Filter
code_block = CodeBlock { "DONOTDELETE-Dynamo Topo Analysis"; }
eq = hot_get_all_filter.VARName == code_block
filterByBoolMask = List.FilterByBoolMask(list=hot_get_all_filter.VARElement, mask=eq)
elements = Custom[CW.SelectionSet.Elements](VARselectionSet=filterByBoolMask.in)  # package Synthesize toolkit; Retrieves all elements stored in a selection set
flatten = List.Flatten(list=elements)

# group: Input
n06_extend_to_plan_views = BoolSelector(true)  # "06.Extend to Plan Views"; graph input
n07_1_exact_name_2_contains_name = IntegerSlider(3, range=1..3 step 1)  # "07.1 = Exact Name | 2 = Contains Name | 3 = All"; graph input
n08_plan_view_name = StringInput("Level 1")  # "08.Plan View Name"; graph input
n15_extend_to_ceiling_views = BoolSelector(false)  # "15.Extend to Ceiling Views"; graph input
n16_1_exact_name_2_contains_name = IntegerSlider(3, range=1..3 step 1)  # "16.1 = Exact Name | 2 = Contains Name | 3 = All"; graph input
n17_ceiling_view_name = StringInput("Level 1")  # "17.Ceiling View Name"; graph input
n24_extend_to_structural_views = BoolSelector(false)  # "24.Extend to Structural Views"; graph input
n25_1_exact_name_2_contains_name = IntegerSlider(3, range=1..3 step 1)  # "25.1 = Exact Name | 2 = Contains Name | 3 = All"; graph input
n26_structural_view_name = StringInput("Level 1")  # "26.Structural View Name"; graph input
n18_extend_to_area_views = BoolSelector(false)  # "18.Extend to Area Views"; graph input
n19_1_exact_name_2_contains_name = IntegerSlider(3, range=1..3 step 1)  # "19.1 = Exact Name | 2 = Contains Name | 3 = All"; graph input
n20_area_view_name = StringInput("Level 1")  # "20.Area View Name"; graph input
n09_extend_to_elevation_views = BoolSelector(true)  # "09.Extend to Elevation Views"; graph input
n10_1_exact_name_2_contains_name = IntegerSlider(3, range=1..3 step 1)  # "10.1 = Exact Name | 2 = Contains Name | 3 = All"; graph input
n11_elevation_view_name = StringInput("North")  # "11.Elevation View Name"; graph input
n12_extend_to_section_views = BoolSelector(true)  # "12.Extend to Section Views"; graph input
n13_1_exact_name_2_contains_name = IntegerSlider(3, range=1..3 step 1)  # "13.1 = Exact Name | 2 = Contains Name | 3 = All"; graph input
n14_section_view_name = StringInput("Section 1")  # "14.Section View Name"; graph input
n03_extend_to_3d_views = BoolSelector(true)  # "03.Extend to 3D Views"; graph input
n04_1_exact_name_2_contains_name = IntegerSlider(3, range=1..3 step 1)  # "04.1 = Exact Name | 2 = Contains Name | 3 = All"; graph input
n05_3d_view_name = StringInput("{3D}")  # "05.3D View Name"; graph input
n21_extend_to_detail_views = BoolSelector(false)  # "21.Extend to Detail Views"; graph input
n22_1_exact_name_2_contains_name = IntegerSlider(3, range=1..3 step 1)  # "22.1 = Exact Name | 2 = Contains Name | 3 = All"; graph input
n23_detail_view_name = StringInput("Detail 0")  # "23.Detail View Name"; graph input
n01_group_to_extend_slope = StringInput("Dynamo K-Slope Analysis")  # "01.Group to Extend (Slope Analysis)"; graph input
n02_group_to_extend_elevation = StringInput("Dynamo K-Elevation Analysis")  # "02.Group to Extend (Elevation Analysis)"; graph input

python_script = Python(IN[0]=n06_extend_to_plan_views, IN[1]=n07_1_exact_name_2_contains_name, IN[2]=n08_plan_view_name, IN[3]=n15_extend_to_ceiling_views, IN[4]=n16_1_exact_name_2_contains_name, IN[5]=n17_ceiling_view_name, IN[6]=n24_extend_to_structural_views, IN[7]=n25_1_exact_name_2_contains_name, IN[8]=n26_structural_view_name, IN[9]=n18_extend_to_area_views, IN[10]=n19_1_exact_name_2_contains_name, IN[11]=n20_area_view_name, IN[12]=n09_extend_to_elevation_views, IN[13]=n10_1_exact_name_2_contains_name, IN[14]=n11_elevation_view_name, IN[15]=n12_extend_to_section_views, IN[16]=n13_1_exact_name_2_contains_name, IN[17]=n14_section_view_name, IN[18]=n03_extend_to_3d_views, IN[19]=n04_1_exact_name_2_contains_name, IN[20]=n05_3d_view_name, IN[21]=n21_extend_to_detail_views, IN[22]=n22_1_exact_name_2_contains_name, IN[23]=n23_detail_view_name)  # IronPython2
# ---------- python_script.python (231 lines) ----------
# Filtering Codes By Karam Baki, karam@aecedx.com
# Copyright(c) 2014, Konrad Sobon
# @arch_laboratory, http://archi-lab.net

import clr
clr.AddReference('ProtoGeometry')
from Autodesk.DesignScript.Geometry import *
 
# Import DocumentManager and TransactionManager
clr.AddReference("RevitServices")
import RevitServices
from RevitServices.Persistence import DocumentManager
from RevitServices.Transactions import TransactionManager
 
# Import RevitAPI
clr.AddReference("RevitAPI")
import Autodesk
from Autodesk.Revit.DB import *
 
doc = DocumentManager.Instance.CurrentDBDocument
uiapp = DocumentManager.Instance.CurrentUIApplication
app = uiapp.Application
 
from System.Collections.Generic import *
 
# Import ToDSType(bool) extension method
clr.AddReference("RevitNodes")
import Revit
clr.ImportExtensions(Revit.Elements)

#collect all views in the model
collector = FilteredElementCollector(doc)
views = collector.OfClass(View).ToElements()
 
#sort views into separate lists based on view type
areaPlans, ceilingPlans, columnSchedules = [], [], []
costReport, details, draftingViews = [], [], []
drawingSheets, elevations, engineetingPlans = [], [], []
floorPlans, internal, legends, loadReports = [], [], [], []
panelSchedules, pressureLossReports, renderings = [], [], []
reports, schedules, sections, threeD = [], [], [], []
undefined, walkthrough = [], []
for i in views:
	if not i.IsTemplate:
		if i.ViewType == ViewType.AreaPlan:
			areaPlans.append(i.ToDSType(True))
		elif i.ViewType == ViewType.CeilingPlan:
			ceilingPlans.append(i.ToDSType(True))
		elif i.ViewType == ViewType.ColumnSchedule:
			columnSchedules.append(i.ToDSType(True))
		elif i.ViewType == ViewType.CostReport:
			costReport.append(i.ToDSType(True))
		elif i.ViewType == ViewType.Detail:
			details.append(i.ToDSType(True))
		elif i.ViewType == ViewType.DraftingView:
			draftingViews.append(i.ToDSType(True))
		elif i.ViewType == ViewType.DrawingSheet:
			drawingSheets.append(i.ToDSType(True))
		elif i.ViewType == ViewType.Elevation:
			elevations.append(i.ToDSType(True))
		elif i.ViewType == ViewType.EngineeringPlan:
			engineetingPlans.append(i.ToDSType(True))
		elif i.ViewType == ViewType.FloorPlan:
			floorPlans.append(i.ToDSType(True))
		elif i.ViewType == ViewType.Internal:
			internal.append(i.ToDSType(True))
		elif i.ViewType == ViewType.Legend:
			legends.append(i.ToDSType(True))
		elif i.ViewType == ViewType.LoadsReport:
			loadReports.append(i.ToDSType(True))
		elif i.ViewType == ViewType.PanelSchedule:
			panelSchedules.append(i.ToDSType(True))
		elif i.ViewType == ViewType.PresureLossReport:
			pressureLossReports.append(i.ToDSType(True))
		elif i.ViewType == ViewType.Rendering:
			renderings.append(i.ToDSType(True))
		elif i.ViewType == ViewType.Report:
			reports.append(i.ToDSType(True))
		elif i.ViewType == ViewType.Schedule:
			schedules.append(i.ToDSType(True))
		elif i.ViewType == ViewType.Section:
			sections.append(i.ToDSType(True))
		elif i.ViewType == ViewType.ThreeD:
			threeD.append(i.ToDSType(True))
		elif i.ViewType == ViewType.Undefined:
			undefined.append(i.ToDSType(True))
		elif i.ViewType == ViewType.Walkthrough:
			walkthrough.append(i.ToDSType(True))
		else:
			continue

overrideplans = IN[0]
planscond = IN[1]
planname = IN[2].lower()

newfloorPlans = []
if overrideplans == True:
	for e in floorPlans:
		if planscond == 1:
			if e.Name.lower() == planname:
				newfloorPlans.append(e)
		elif planscond == 2:
			if planname in e.Name.lower():
				newfloorPlans.append(e)
		elif planscond == 3:
			newfloorPlans.append(e)

overrideceilings = IN[3]
ceilingscond = IN[4]
ceilingname = IN[5].lower()

newceilingPlans = []
if overrideceilings == True:
	for e in ceilingPlans:
		if ceilingscond == 1:
			if e.Name.lower() == ceilingname:
				newceilingPlans.append(e)
		elif ceilingscond == 2:
			if ceilingname in e.Name.lower():
				newceilingPlans.append(e)
		elif ceilingscond == 3:
			newceilingPlans.append(e)

overrideengineeting = IN[6]
engineetingscond = IN[7]
engineetingname = IN[8].lower()	

newengineetingPlans = []
if overrideengineeting == True:
	for e in engineetingPlans:
		if engineetingscond == 1:
			if e.Name.lower() == engineetingname:
				newengineetingPlans.append(e)
		elif engineetingscond == 2:
			if engineetingname in e.Name.lower():
				newengineetingPlans.append(e)
		elif engineetingscond == 3:
			newengineetingPlans.append(e)		
			
overridearea = IN[9]
areascond = IN[10]
areaname = IN[11].lower()	

newareaPlans = []
if overridearea == True:
	for e in areaPlans:
		if areascond == 1:
			if e.Name.lower() == areaname:
				newareaPlans.append(e)
		elif areascond == 2:
			if areaname in e.Name.lower():
				newareaPlans.append(e)
		elif areascond == 3:
			newareaPlans.append(e)

overrideelvs = IN[12]
elvsscond = IN[13]
elvsname = IN[14].lower()	

newelvs = []
if overrideelvs == True:
	for e in elevations:
		if elvsscond == 1:
			if e.Name.lower() == elvsname:
				newelvs.append(e)
		elif elvsscond == 2:
			if elvsname in e.Name.lower():
				newelvs.append(e)
		elif elvsscond == 3:
			newelvs.append(e)

overridesec = IN[15]
secscond = IN[16]
secsname = IN[17].lower()	

newsections = []
if overridesec == True:
	for e in sections:
		if secscond == 1:
			if e.Name.lower() == secsname:
				newsections.append(e)
		elif secscond == 2:
			if secsname in e.Name.lower():
				newsections.append(e)
		elif secscond == 3:
			newsections.append(e)
			
overridethreede = IN[18]
threedescond = IN[19]
threedename = IN[20].lower()	

newthreedes = []
if overridethreede == True:
	for e in threeD:
		if threedescond == 1:
			if e.Name.lower() == threedename:
				newthreedes.append(e)
		elif threedescond == 2:
			if threedename in e.Name.lower():
				newthreedes.append(e)
		elif threedescond == 3:
			newthreedes.append(e)
			
overridedet = IN[21]
detscond = IN[22]
detname = IN[23].lower()	

newdets = []
if overridedet == True:
	for e in details:
		if detscond == 1:
			if e.Name.lower() == detname:
				newdets.append(e)
		elif detscond == 2:
			if detname in e.Name.lower():
				newdets.append(e)
		elif detscond == 3:
			newdets.append(e)
			
'''
#Assign your output to the OUT variable
OUT = areaPlans, ceilingPlans, columnSchedules, costReport, \
	details, draftingViews, drawingSheets, elevations, \
	engineetingPlans, floorPlans, internal, legends, \
	loadReports, panelSchedules, pressureLossReports, \
	renderings, reports, schedules, sections, threeD, \
	undefined, walkthrough
'''

result = newfloorPlans + newceilingPlans + newengineetingPlans + newareaPlans + newelvs + newsections + newthreedes + newdets
OUT = result 
# ----------------------------------------
code_block_2 = CodeBlock { 90; }
overrideTransparencyInView = Custom[CW.Element.OverrideTransparencyInView](VARelement=flatten, VARview=python_script@L1, VARtransparencyPercentage=code_block_2)  # package Synthesize toolkit; Overrides the transparency of an element in a given view
create = List.Create(item0=n01_group_to_extend_slope, item1=n02_group_to_extend_elevation)
modelGroupByName = Custom[RH.Collector.ModelGroupByName](VARgroupName=create@L1)  # package Synthesize toolkit; This will collect all instances of a model group by given name.
members = Custom[CW.Group.Members](VARgroup=modelGroupByName)  # package Synthesize toolkit; Retrieves the members of a group
flatten_2 = List.Flatten(list=members)
copy_element_overrides = Custom[Copy Element Overrides](VARViews=python_script, VARElements=flatten_2)  # package Synthesize toolkit; Copy Element Overrides
