# Dynamo graph Analyse.Topo Analysis Visibility Control.dyn (Dynamo 2.13.1.3887)
# author: karam@aecedx.com
# packages: Synthesize toolkit 12.5.1

# group: Input
n02_active_view_only = BoolSelector(false)  # "02.Active View only"; graph input
n01_filter_visibility = BoolSelector(false)  # "01.Filter visibility"; graph input

hot_get_revit_activeview = Custom[HOT.Get Revit ActiveView]()  # package Synthesize toolkit; Active View
views = Custom[CW.Document.Views]()  # package Synthesize toolkit; Gets all views in the document - except for 3D view templates (as long as this bug is not fixed: https://github.com/DynamoDS/Dynamo/issues/2970)
flatten = List.Flatten(list=views)
code_block = CodeBlock { 1; }
chop = List.Chop(list=flatten, lengths=code_block)
scopeIf = Custom[CW.ScopeIf+](VARtest=n02_active_view_only, VARtrue=hot_get_revit_activeview, VARfalse=chop)  # package Synthesize toolkit; A (hopefully) more robust implementation of ScopeIf. Tests a single boolean and returns a value accordingly.
flatten_2 = List.Flatten(list=scopeIf)
uniqueItems = List.UniqueItems(list=flatten_2)
chop_2 = List.Chop(list=uniqueItems, lengths=code_block)
hot_get_all_filter = Custom[HOT.Get All Filter]()  # package Synthesize toolkit; Get all Filter
flatten_3 = List.Flatten(list=hot_get_all_filter.VARId)
n03_group_to_use = StringInput("Dynamo K-Slope Analysis")  # "03.Group to Use"; graph input
views_2 = Custom[CW.Document.Views]()
flatten_4 = List.Flatten(list=views_2)
code_block_2 = CodeBlock { 1; }
chop_3 = List.Chop(list=flatten_4, lengths=code_block_2)
hot_get_all_filter_2 = Custom[HOT.Get All Filter]()
flatten_5 = List.Flatten(list=hot_get_all_filter_2.VARId)
hot_get_all_filter_3 = Custom[HOT.Get All Filter]()
eq = hot_get_all_filter_3.VARName == n03_group_to_use
filterByBoolMask = List.FilterByBoolMask(list=hot_get_all_filter_3.VARName, mask=eq)
code_block_3 = CodeBlock { false; }
replaceEmptyLists = Custom[CW.List.ReplaceEmptyLists](VARseq=filterByBoolMask.in@L3, VARReplacement=code_block_3)  # package Synthesize toolkit; Replaces all empty lists within a given list with a substitute
flatten_6 = List.Flatten(list=replaceEmptyLists)
code_block_4 = CodeBlock { null; }
scopeIf_2 = Custom[CW.ScopeIf+](VARtest=flatten_6, VARtrue=code_block_4, VARfalse=n03_group_to_use)
modelGroupByName = Custom[RH.Collector.ModelGroupByName](VARgroupName=n03_group_to_use)  # package Synthesize toolkit; This will collect all instances of a model group by given name.
members = Custom[CW.Group.Members](VARgroup=modelGroupByName)  # package Synthesize toolkit; Retrieves the members of a group
flatten_7 = List.Flatten(list=members@L2)
scopeIf_3 = Custom[CW.ScopeIf+](VARtest=flatten_6, VARtrue=code_block_4, VARfalse=flatten_7)
flatten_8 = List.Flatten(list=scopeIf_3)
byElements = Custom[CW.SelectionSet.ByElements](VARName=scopeIf_2, VARelements=flatten_8)  # package Synthesize toolkit; Creates a selection set of the given elements. Note that if a selection set of the given name already exists in the model, its contents will be replaced. Also, if the selection set is already applied as a view filter, the view filter will have to be manually updated in the visibility / graphic overrides. DO ***NOT*** USE IN AUTOMATIC MODE!
passthrough = Custom[CW.Passthrough](VARpassThrough=n03_group_to_use, VARwaitFor=byElements.VARselectionSet)  # package Synthesize toolkit; Forces a sequential order of execution. The node wired into the output of the Passthrough node will be executed *after* the node wired into the waitFor input (e.g. important for some Revit operations). The value of the passThrough input will be passed on to the node wired into the output port of the Passthrough node.
eq_2 = hot_get_all_filter_2.VARName == passthrough
filterByBoolMask_2 = List.FilterByBoolMask(list=flatten_5, mask=eq_2)
flatten_9 = List.Flatten(list=filterByBoolMask_2.in)
hot_add_filter_to_view = Custom[HOT.Add Filter to View](VARView=chop_3@L1, VAR=flatten_9)  # package Synthesize toolkit; Add Filter to View
passthrough_2 = Custom[CW.Passthrough](VARpassThrough=n03_group_to_use, VARwaitFor=hot_add_filter_to_view)
eq_3 = hot_get_all_filter.VARName == passthrough_2
filterByBoolMask_3 = List.FilterByBoolMask(list=flatten_3, mask=eq_3)
code_block_5 = CodeBlock { null; }
replaceEmptyLists_2 = Custom[CW.List.ReplaceEmptyLists](VARseq=filterByBoolMask_3.in@L3, VARReplacement=code_block_5)
flatten_10 = List.Flatten(list=replaceEmptyLists_2)
hot_view_set_filter_visibility = Custom[HOT.View Set Filter Visibility](VARView=chop_2@L1, VARVisibility=n01_filter_visibility, VARFilterId=flatten_10)  # package Synthesize toolkit; Set View Filter Visibility
code_block_6 = CodeBlock { null; }
n04_select_topography = DSModelElementSelection()  # "04.Select Topography"; nothing selected; graph input
scopeIf_4 = Custom[CW.ScopeIf+](VARtest=n01_filter_visibility, VARtrue=code_block_6, VARfalse=n04_select_topography)
hot_get_revit_activeview_2 = Custom[HOT.Get Revit ActiveView]()
scopeIf_5 = Custom[CW.ScopeIf+](VARtest=n02_active_view_only, VARtrue=hot_get_revit_activeview_2, VARfalse=chop)
flatten_11 = List.Flatten(list=scopeIf_5)
uniqueItems_2 = List.UniqueItems(list=flatten_11)
chop_4 = List.Chop(list=uniqueItems_2, lengths=code_block)
scopeIf_6 = Custom[CW.ScopeIf+](VARtest=n01_filter_visibility, VARtrue=code_block_6, VARfalse=chop_4)
code_block_7 = CodeBlock { 0; }
overrideTransparencyInView = Custom[CW.Element.OverrideTransparencyInView](VARelement=scopeIf_4, VARview=scopeIf_6@L1, VARtransparencyPercentage=code_block_7)  # package Synthesize toolkit; Overrides the transparency of an element in a given view
scopeIf_7 = Custom[CW.ScopeIf+](VARtest=n01_filter_visibility, VARtrue=n04_select_topography, VARfalse=code_block_6)
scopeIf_8 = Custom[CW.ScopeIf+](VARtest=n01_filter_visibility, VARtrue=chop_4, VARfalse=code_block_6)
code_block_8 = CodeBlock { 90; }
overrideTransparencyInView_2 = Custom[CW.Element.OverrideTransparencyInView](VARelement=scopeIf_7, VARview=scopeIf_8@L1, VARtransparencyPercentage=code_block_8)
debug_python = Custom[Debug Python]()  # package Synthesize toolkit; Debug Python
