# Dynamo graph Analyse.Warnings Report File Temporary Isolate With Colors.dyn (Dynamo 2.13.1.3887)
# author: karam@aecedx.com
# packages: Synthesize toolkit 12.5.1

# group: Input
n01_report_file = Filename("No file selected.")  # "01.Report File"; graph input
n11_create_selection_filter = BoolSelector(true)  # "11.Create Selection Filter ?"; graph input
n13_overwrite_existing_filter = BoolSelector(true)  # "13.Overwrite Existing Filter ? (False for Adding Elements)"; graph input
n05_override_cut_fill_colors = BoolSelector(false)  # "05.Override Cut Fill Colors ?"; graph input
n06_force_cut_fill_color_with = BoolSelector(false)  # "06.Force Cut Fill Color With Black ?"; graph input
n03_override_projection_fill = BoolSelector(true)  # "03.Override Projection Fill Colors ?"; graph input
n09_override_cut_lines_color = BoolSelector(false)  # "09.Override Cut Lines Color ?"; graph input
n08_override_projection_lines = BoolSelector(false)  # "08.Override Projection Lines Color ?"; graph input
n07_cut_pattern = FillPatterns("<Solid fill>")  # "07.Cut Pattern"; graph input
n04_projection_pattern = FillPatterns("<Solid fill>")  # "04.Projection Pattern"; graph input
transparancy = DoubleSlider(0, range=0..100 step 1)  # "10.Transparancy"; graph input
n02_temporary_isolate_warnings = BoolSelector(true)  # "02.Temporary Isolate Warnings ?"; graph input
n12_filter_name_to_create = StringInput("Dynamo Warnings-Interferences")  # "12.Filter Name to Create"; graph input

parse = Custom[SP.ErrorReport.Parse](VARReport=n01_report_file)  # package Synthesize toolkit; K-Warnings Read
code_block = CodeBlock { null; false; }
clean = List.Clean(list=parse.VARElements, preserveIndices=code_block.out1)
count = List.Count(list=clean)

# group: Report
n01_number_of_warnings = Watch(count)  # "01.Number of Warnings / Interferences"; graph output

as_list_groupbykey = Custom[AS.[&] List.GroupByKey](VARobjectList=clean, VARkeys=parse.VARWarnings)  # package Synthesize toolkit; Sort the items of a list into groups (sublists) based on the corresponding items of a reference list. Example: The list {A,B,C,D,E} with the reference list {1,anyWord,4,anyWord,1} will be grouped into lists as { {A,E}, {B,D}, {C} } and the unique references will be {1, anyWord, 4}.
flatten = List.Flatten(list=as_list_groupbykey.VARgroups@L3)
generate_selection_filter = Custom[Generate Selection Filter](VARCreateSelectionFilter=n11_create_selection_filter, VARFilterNametoCreate=as_list_groupbykey.VARuniquekeys@L1, VAROverwriteExistingFilter=n13_overwrite_existing_filter, VARElements=flatten@L2)  # package Synthesize toolkit; Generate Selection FIlter
as_list_groupbykey_2 = Custom[AS.[&] List.GroupByKey](VARobjectList=clean, VARkeys=parse.VARWarnings)
id = Element.Id(element=as_list_groupbykey_2.VARgroups)
python_script = Python(IN[0]=id)  # IronPython2
# ---------- python_script.python (66 lines) ----------
# Enable Python support and load DesignScript library
# IMPORTANT : ALL DYNAMO DESIGN SCRIPT NODES ARE AS (dg)
import clr
clr.AddReference('ProtoGeometry')
from Autodesk.DesignScript import Geometry as dg

# EXTENSION Enable ToDSType
clr.AddReference('RevitNodes')
import Revit
clr.ImportExtensions(Revit.Elements)

# Enable Revit Elements
from Revit.Elements import *

# EXTENSION Enable Geometry Conversion Methods
clr.ImportExtensions(Revit.GeometryConversion)

# Enable Revit API
clr.AddReference('RevitAPI')
from Autodesk.Revit.DB import *

# Enable DocumentManager and TransactionManager
clr.AddReference('RevitServices')
from RevitServices.Persistence import DocumentManager
from RevitServices.Transactions import TransactionManager

# Enable ICollection List Translate
clr.AddReference("System")
import System.Collections.Generic
from System.Collections.Generic import List


dataEnteringNode = IN
# Use UnwrapElement(IN[0]) When Translating From Dynamo to Revit
groups = UnwrapElement(IN[0])

# Choose The Current Document
doc = DocumentManager.Instance.CurrentDBDocument
uidoc = DocumentManager.Instance.CurrentUIApplication.ActiveUIDocument
uiapp = DocumentManager.Instance.CurrentUIApplication
app = uiapp.Application

def merge(lsts):
    sets = [set(lst) for lst in lsts if lst]
    merged = True
    while merged:
        merged = False
        results = []
        while sets:
            common, rest = sets[0], sets[1:]
            sets = []
            for x in rest:
                if x.isdisjoint(common):
                    sets.append(x)
                else:
                    merged = True
                    common |= x
            results.append(common)
        sets = results
    return sets

result = []
for g in groups:
	result.append(merge(g))
# Assign your output to the OUT variable.
OUT = result
# ----------------------------------------
simple_byelement_id_selection = Custom[Simple ByElement Id Selection](VARId=python_script)  # package Synthesize toolkit; Simple ByElement Id Selection
flatten_2 = List.Flatten(list=simple_byelement_id_selection@L2)
code_block_2 = CodeBlock { 255; 0; }
byARGB = Color.ByARGB(alpha=code_block_2.out0, red=code_block_2.out1, green=code_block_2.out1, blue=code_block_2.out1)
colorPicker = Custom[RH.UI.ColorPicker]()  # package Synthesize toolkit; This node allows the user to choose a color via the Revit API color selection dialog. For Revit 2017 +
colorPicker_2 = Custom[RH.UI.ColorPicker]()
colorPicker_3 = Custom[RH.UI.ColorPicker]()
create = List.Create(item0=colorPicker.VARdynamoColor, item1=colorPicker_2.VARdynamoColor, item2=colorPicker_3.VARdynamoColor)
code_block_3 = CodeBlock { 1; }
count_2 = List.Count(list=create)
sequence = Sequence(start=code_block_3, amount=count_2, step=code_block_3, lacing=Longest)
code_block_4 = CodeBlock { 0; 1; null; }
remapRange = Math.RemapRange(numbers=sequence, newMin=code_block_4.out0, newMax=code_block_4.out1)
count_3 = List.Count(list=flatten_2)
sequence_2 = Sequence(start=code_block_3, amount=count_3, step=code_block_3, lacing=Longest)
remapRange_2 = Math.RemapRange(numbers=sequence_2, newMin=code_block_4.out0, newMax=code_block_4.out1)
color_range = ColorRange(colors=create, indices=remapRange, value=remapRange_2)
shuffle = List.Shuffle(list=color_range)
alpha = Color.Alpha(color=shuffle)
red = Color.Red(color=shuffle)
green = Color.Green(color=shuffle)
blue = Color.Blue(color=shuffle)
byARGB_2 = Color.ByARGB(alpha=alpha, red=red, green=green, blue=blue)
count_4 = List.Count(list=byARGB_2)
cycle = List.Cycle(list=byARGB, amount=count_4)
scopeIf = Custom[CW.ScopeIf+](VARtest=n06_force_cut_fill_color_with, VARtrue=cycle, VARfalse=byARGB_2)  # package Synthesize toolkit; A (hopefully) more robust implementation of ScopeIf. Tests a single boolean and returns a value accordingly.
scopeIf_2 = Custom[CW.ScopeIf+](VARtest=n05_override_cut_fill_colors, VARtrue=scopeIf, VARfalse=byARGB_2)
code_block_5 = CodeBlock { null; }
scopeIf_3 = Custom[CW.ScopeIf+](VARtest=n03_override_projection_fill, VARtrue=byARGB_2, VARfalse=code_block_5)
code_block_6 = CodeBlock { null; }
scopeIf_4 = Custom[CW.ScopeIf+](VARtest=n09_override_cut_lines_color, VARtrue=byARGB_2, VARfalse=code_block_6)
scopeIf_5 = Custom[CW.ScopeIf+](VARtest=n08_override_projection_lines, VARtrue=byARGB_2, VARfalse=code_block_6)
code_block_7 = CodeBlock { null; }
scopeIf_6 = Custom[CW.ScopeIf+](VARtest=n05_override_cut_fill_colors, VARtrue=n07_cut_pattern, VARfalse=code_block_7)
scopeIf_7 = Custom[CW.ScopeIf+](VARtest=n03_override_projection_fill, VARtrue=n04_projection_pattern, VARfalse=code_block_5)
count_5 = List.Count(list=flatten_2)
cycle_2 = List.Cycle(list=transparancy, amount=count_5)
byProperties = Revit.Filter.OverrideGraphicSettings.ByProperties(cutFillColor=scopeIf_2, projectionFillColor=scopeIf_3, cutLineColor=scopeIf_4, projectionLineColor=scopeIf_5, cutFillPattern=scopeIf_6, projectionFillPattern=scopeIf_7, transparency=cycle_2, lacing=Longest)
overrideInView = Element.OverrideInView(element=flatten_2, overrides=byProperties)
current = Document.Current()
activeView = Document.ActiveView(document=current)
scopeIf_8 = Custom[CW.ScopeIf+](VARtest=n02_temporary_isolate_warnings, VARtrue=activeView, VARfalse=code_block.out0)
scopeIf_9 = Custom[CW.ScopeIf+](VARtest=n02_temporary_isolate_warnings, VARtrue=parse.VARElements, VARfalse=code_block.out0)
clean_2 = List.Clean(list=scopeIf_9, preserveIndices=code_block.out1)
flatten_3 = List.Flatten(list=clean_2)
temporarilyIsolateInView = Custom[CW.Element.TemporarilyIsolateInView](VARview=scopeIf_8, VARelement=flatten_3)  # package Synthesize toolkit; (Temporarily) isolates elements in the given view
debug_python = Custom[Debug Python]()  # package Synthesize toolkit; Debug Python
