# Dynamo graph Animate.By Family with Parameter Min - Max Values and Moving Camera.dyn (Dynamo 2.13.1.3887)
# author: karam@aecedx.com
# packages: Synthesize toolkit 12.5.1

n07_frames = DoubleInput(40)  # "07.Frames ?"; graph input
n01_directory_export_path = Directory("C:\Users\karam\Desktop\Conceptual Toolkit")  # "01.Directory Export Path"; graph input
n06_from_what_view = Views()  # "06.From What View ?"; nothing selected; graph input
n02_all_elements_of_family_type = FamilyTypes()  # "02.All Elements of Family type :"; nothing selected; graph input
all_elements_of_family_type = ElementsOfFamilyType(Family_Type=n02_all_elements_of_family_type)
n03_parameter_name = StringInput("")  # "03.Parameter Name ?"; graph input
n04_minimum_parameter_number = DoubleInput(1)  # "04.Minimum Parameter Number"; graph input
n05_maximum_parameter_number = DoubleInput(15)  # "05.Maximum Parameter Number"; graph input
n08_select_camera_path = DSModelElementSelection()  # "08.Select Camera Path"; nothing selected; graph input
n09_select_target_element = DSModelElementSelection()  # "09.Select Target Element"; nothing selected; graph input
boundingBox = Element.BoundingBox(element=n09_select_target_element)
maxPoint = BoundingBox.MaxPoint(boundingBox=boundingBox)
minPoint = BoundingBox.MinPoint(boundingBox=boundingBox)
byStartPointEndPoint = Line.ByStartPointEndPoint(startPoint=maxPoint, endPoint=minPoint)
code_block = CodeBlock { 0.5; }
pointAtParameter = Curve.PointAtParameter(curve=byStartPointEndPoint, param=code_block)
da_dynanimate_numeric_parameter = Custom[DA.Dynanimate Numeric Parameter And Camera Position With Fixed Target](VARIterations=n07_frames, VARDirectoryPath=n01_directory_export_path, VARView=n06_from_what_view, VARElements=all_elements_of_family_type, VARParameterName=n03_parameter_name, VARMinParamValue=n04_minimum_parameter_number, VARMaxParamValue=n05_maximum_parameter_number, VARCameraPath=n08_select_camera_path, VARTargetPosition=pointAtParameter)  # package Synthesize toolkit; Animates the camera of a perspective view around a fixed target.
debug_python = Custom[Debug Python]()  # package Synthesize toolkit; Debug Python
