# Dynamo graph Area.Areas Separators By Curves.dyn (Dynamo 2.13.1.3887)
# author: karam@aecedx.com
# packages: Synthesize toolkit 12.5.1

# group: Input
n02_delete_old_curves = BoolSelector(false)  # "02.Delete Old Curves ?"; graph input
n01_select_curves = DSModelElementsSelection()  # "01.Select Curves"; nothing selected; graph input
n03_create_selection_filter = BoolSelector(true)  # "03.Create Selection Filter ?"; graph input
n04_filter_name_to_create = StringInput("Dynamo Area Plans Separators")  # "04.Filter Name to Create"; graph input
n05_overwrite_existing_filter = BoolSelector(false)  # "05.Overwrite Existing Filter"; graph input

curves = Element.Curves(element=n01_select_curves)
isEmpty = List.IsEmpty(list=curves, lacing=Longest)
filterByBoolMask = List.FilterByBoolMask(list=n01_select_curves, mask=isEmpty)
empty = List.Empty()
scopeIf = Custom[CW.ScopeIf+](VARtest=n02_delete_old_curves, VARtrue=filterByBoolMask.out, VARfalse=empty)  # package Synthesize toolkit; A (hopefully) more robust implementation of ScopeIf. Tests a single boolean and returns a value accordingly.
eraser = Custom[ST.Tool.Eraser](VARList=scopeIf)  # package Synthesize toolkit; Try to delete any element from project
debug_python_no_message = Custom[Debug Python No Message]()  # package Synthesize toolkit; Debug Python
isClosed = Curve.IsClosed(curve=curves)
filterByBoolMask_2 = List.FilterByBoolMask(list=curves, mask=isClosed)
flatten = List.Flatten(list=filterByBoolMask_2.in)
code_block = CodeBlock { 1; }
chop = List.Chop(list=flatten, lengths=code_block)
curves_offset_to_revit = Custom[Curves Offset To Revit Compatibility](VARCurves=chop)  # package Synthesize toolkit; Curves Offset To Revit Compatibility
flatten_2 = List.Flatten(list=curves_offset_to_revit.VARRevitCurves)
python_script = Python(IN[0]=flatten_2)  # IronPython2
# ---------- python_script.python (41 lines) ----------
import clr
clr.AddReference('RevitAPI')
from Autodesk.Revit.DB import *

clr.AddReference("RevitNodes")
import Revit
clr.ImportExtensions(Revit.GeometryConversion)

clr.AddReference("RevitServices")
import RevitServices
from RevitServices.Persistence import DocumentManager
from RevitServices.Transactions import TransactionManager

clr.AddReference("RevitAPIUI")
from Autodesk.Revit.UI import TaskDialog

def tolist(obj1):
	if hasattr(obj1,'__iter__'): return obj1
	else: return [obj1]

doc = DocumentManager.Instance.CurrentDBDocument
curves = UnwrapElement(tolist(IN[0]))

if len(curves) != 0:
	elementlist = list()
	view = doc.ActiveView
	if str(view.ViewType) == "AreaPlan":
		TransactionManager.Instance.EnsureInTransaction(doc)
		doccreation = doc.Create
		for curve in curves:
			try:
				separator = doccreation.NewAreaBoundaryLine(view.SketchPlane, curve, view)
				elementlist.append(separator)
			except:
				elementlist.append(None)
		TransactionManager.Instance.TransactionTaskDone()
		OUT = elementlist
	else:
		OUT = TaskDialog.Show("AECedx - Karam", "The Active View Must Be Area Plan")
else:
	OUT = "Nothing to Do"
# ----------------------------------------
anyFalse = Custom[CW.List.AnyFalse](VARseq=isClosed)  # package Synthesize toolkit; Returns true if any item in a list of booleans is false.
filterByBoolMask_3 = List.FilterByBoolMask(list=n01_select_curves, mask=anyFalse)
python_script_2 = Python(IN[0]=filterByBoolMask_3.in)  # IronPython2
# ---------- python_script_2.python (41 lines) ----------
import clr
clr.AddReference('RevitAPI')
from Autodesk.Revit.DB import *

clr.AddReference("RevitNodes")
import Revit
clr.ImportExtensions(Revit.GeometryConversion)

clr.AddReference("RevitServices")
import RevitServices
from RevitServices.Persistence import DocumentManager
from RevitServices.Transactions import TransactionManager

clr.AddReference("RevitAPIUI")
from Autodesk.Revit.UI import TaskDialog

def tolist(obj1):
	if hasattr(obj1,'__iter__'): return obj1
	else: return [obj1]

doc = DocumentManager.Instance.CurrentDBDocument
curves = UnwrapElement(tolist(IN[0]))

if len(curves) != 0:
	elementlist = list()
	view = doc.ActiveView
	if str(view.ViewType) == "AreaPlan":
		TransactionManager.Instance.EnsureInTransaction(doc)
		doccreation = doc.Create
		for curve in curves:
			try:
				separator = doccreation.NewAreaBoundaryLine(view.SketchPlane, curve.GeometryCurve, view)
				elementlist.append(separator)
			except:
				elementlist.append(None)
		TransactionManager.Instance.TransactionTaskDone()
		OUT = elementlist
	else:
		OUT = TaskDialog.Show("AECedx - Karam", "The Active View Must Be Area Plan")
else:
	OUT = "Nothing to Do"
# ----------------------------------------
create = List.Create(item0=python_script, item1=python_script_2)
code_block_2 = CodeBlock { false; }
clean = List.Clean(list=create, preserveIndices=code_block_2)
flatten_3 = List.Flatten(list=clean)
generate_selection_filter = Custom[Generate Selection Filter](VARCreateSelectionFilter=n03_create_selection_filter, VARFilterNametoCreate=n04_filter_name_to_create, VAROverwriteExistingFilter=n05_overwrite_existing_filter, VARElements=flatten_3)  # package Synthesize toolkit; Generate Selection FIlter
