# Dynamo graph Conceptual.Adaptive K-Rationalize Deviation By Faces Selection.dyn (Dynamo 2.13.1.3887)
# author: karam@aecedx.com
# packages: Synthesize toolkit 12.5.1

# group: Input
n11_transfer_family_to_revit = BoolSelector(false)  # "11.Transfer Family To Revit"; graph input
n02_adjacent_surfaces_mode = BoolSelector(false)  # "02.Adjacent Surfaces Mode ?"; graph input
n01_select_faces = SelectFaces()  # "01.Select Faces"; 3 picked in the model; graph input
n07_keep_already_planar_surfaces = BoolSelector(false)  # "07.Keep Already Planar Surfaces"; graph input
n04_weight_planar_goal = IntegerSlider(3, range=-1..1000 step 1)  # "04.Weight: Planar Goal"; graph input
n05_weight_original_shape_goal = IntegerSlider(1, range=-1..1000 step 1)  # "05.Weight: Original Shape Goal"; graph input
n08_points_merge_threshold = DoubleInput(0.1)  # "08.Points Merge Threshold"; graph input
n03_iterations_attempts = IntegerSlider(100000, range=1..100000 step 1)  # "03.Iterations (Attempts)"; graph input
n09_with_momentum = BoolSelector(true)  # "09.With Momentum ?"; graph input
n10_force_planar = BoolSelector(false)  # "10.Force Planar ?"; graph input
n12_transfer_family_to_revit_use = BoolSelector(true)  # "12.Transfer Family To Revit: Use Import Instance Instead"; graph input
scale_midpoint_color = DoubleSlider(20, range=2..100 step 1)
analysis_density = IntegerSlider(5, range=3..10 step 1)

join = List.Join()  # unwired: list0, list1, list2, list3
group_adjacent_surfaces = Custom[Group Adjacent Surfaces](VARSurfaces=n01_select_faces, VARGroupOrNot=n02_adjacent_surfaces_mode)  # package Synthesize toolkit; Join Adjacent Surfaces
explode = Geometry.Explode(geometry=group_adjacent_surfaces)
flatten = List.Flatten(list=explode@L2)
empty = List.Empty()
scopeIf = Custom[CW.ScopeIf+](VARtest=n02_adjacent_surfaces_mode, VARtrue=n01_select_faces, VARfalse=empty)  # package Synthesize toolkit; A (hopefully) more robust implementation of ScopeIf. Tests a single boolean and returns a value accordingly.
smart_prepare_divided_surfaces = Custom[Smart Prepare Divided Surfaces Geometry](VARSurfaces=scopeIf)  # package Synthesize toolkit; Smart Prepare Divided Surfaces Geometry
scopeIf_2 = Custom[CW.ScopeIf+](VARtest=n02_adjacent_surfaces_mode, VARtrue=flatten, VARfalse=smart_prepare_divided_surfaces.VARSurfaces)
perimeterCurves = Surface.PerimeterCurves(surface=scopeIf_2)
startPoint = Curve.StartPoint(curve=perimeterCurves)
isPlanar = Custom[CW.Surface.IsPlanar](VARsurface=scopeIf_2@L2)  # package Synthesize toolkit; Checks whether a face is planar
code_block = CodeBlock { false; }
count = List.Count(list=isPlanar@L2)
ofRepeatedItem = List.OfRepeatedItem(item=code_block, amount=count)
scopeIf_3 = Custom[CW.ScopeIf+](VARtest=n07_keep_already_planar_surfaces, VARtrue=isPlanar, VARfalse=ofRepeatedItem)
filterByBoolMask = List.FilterByBoolMask(list=startPoint, mask=scopeIf_3)
coPlanarGoal_Create = DynaShape.ZeroTouch.Goals.CoPlanarGoal_Create(startPositions=filterByBoolMask.out, weight=n04_weight_planar_goal)
isNull = Object.IsNull(object=coPlanarGoal_Create)
filterByBoolMask_2 = List.FilterByBoolMask(list=coPlanarGoal_Create, mask=isNull)
shapeMatchingGoal_Create = DynaShape.ZeroTouch.Goals.ShapeMatchingGoal_Create(startPositions=startPoint, targetShapePoints=startPoint, weight=n05_weight_original_shape_goal)
filterByBoolMask_3 = List.FilterByBoolMask(list=scopeIf_2, mask=scopeIf_3)
code_block_2 = CodeBlock { 0.5; }
pointAtParameter = Surface.PointAtParameter(surface=filterByBoolMask_3.in, u=code_block_2, v=code_block_2)
normalAtParameter = Surface.NormalAtParameter(surface=filterByBoolMask_3.in, u=code_block_2, v=code_block_2)
byOriginNormal = Plane.ByOriginNormal(origin=pointAtParameter, normal=normalAtParameter)
onPlaneGoal_Create = DynaShape.ZeroTouch.Goals.OnPlaneGoal_Create(startPositions=filterByBoolMask.in@L2, targetPlane=byOriginNormal@L2, weight=n04_weight_planar_goal)
endPoint = Curve.EndPoint(curve=perimeterCurves)
byStartPointEndPoint = Line.ByStartPointEndPoint(startPoint=startPoint, endPoint=endPoint)
length = Curve.Length(curve=byStartPointEndPoint)
n06_weight_original_lengths_goal = IntegerSlider(1, range=-1..1000 step 1)  # "06.Weight: Original Lengths Goal"; graph input
lengthGoal_Create = DynaShape.ZeroTouch.Goals.LengthGoal_Create(startPosition1=startPoint, startPosition2=endPoint, targetLength=length, weight=n06_weight_original_lengths_goal)
flatten_2 = List.Flatten(list=lengthGoal_Create@L3)
combine = List.Combine(combineFunction=join, list0=filterByBoolMask_2.out, list1=shapeMatchingGoal_Create, list2=onPlaneGoal_Create, list3=flatten_2)
code_block_3 = CodeBlock { true; }
polylineBinder = DynaShape.ZeroTouch.GeometryBinders.PolylineBinder(vertices=startPoint, loop=code_block_3)
metersInput = Custom[MetersInput](VARInput=n08_points_merge_threshold)  # package Synthesize toolkit; MetersInput
code_block_4 = CodeBlock { 0.000000001; }
metersInput_2 = Custom[MetersInput](VARInput=code_block_4)
code_block_5 = CodeBlock { true; }
executeSilently = DynaShape.ZeroTouch.Solver.ExecuteSilently(goals=combine, geometryBinders=polylineBinder, nodeMergeThreshold=metersInput, iterations=n03_iterations_attempts, terminationThreshold=metersInput_2, execute=code_block_5, enableMomentum=n09_with_momentum)
byPatch = Surface.ByPatch(closedCurve=executeSilently.geometries)
force_surface_to_planar = Custom[Force Surface to Planar](VARSurfaces=byPatch, VARForceOrNot=n10_force_planar)  # package Synthesize toolkit; Force Surface to Planar
empty_2 = List.Empty()
scopeIf_4 = Custom[CW.ScopeIf+](VARtest=n11_transfer_family_to_revit, VARtrue=force_surface_to_planar.VARSurfaces, VARfalse=empty_2)
k_family_insert = Custom[K-Family Insert](VARGeometryorSAT=scopeIf_4, VARImportInstanceInstead=n12_transfer_family_to_revit_use)  # package Synthesize toolkit; K-Family Insert

# group: Preview
flatten_3 = List.Flatten(list=force_surface_to_planar.VARPerimeterCurves)

smart_translate_for_k = Custom[Smart Translate For K-Rationalize](VARGeometry=scopeIf_2)  # package Synthesize toolkit; Smart Translate For K-Rationalize

# group: Preview
perimeterCurves_2 = Surface.PerimeterCurves(surface=smart_translate_for_k)

surface_color_analysis_display = Custom[Surface Color Analysis Display For K-Rationalize](VAROldSurfaces=smart_translate_for_k, VARNewSurfaces=byPatch, VARScaleMidpointColor=scale_midpoint_color, VARAnalysisDensity=analysis_density)  # package Synthesize toolkit; Color Analysis Display For K-Rationalize

# group: Preview
bySurfaceColors = Modifiers.GeometryColor.BySurfaceColors(surface=surface_color_analysis_display.VARDisplayOldSurface, colors=surface_color_analysis_display.VARDisplayOldColors)
bySurfaceColors_2 = Modifiers.GeometryColor.BySurfaceColors(surface=surface_color_analysis_display.VARDisplayNewSurface, colors=surface_color_analysis_display.VARDisplayNewColors)

debug_python_no_message = Custom[Debug Python No Message]()  # package Synthesize toolkit; Debug Python
