# Dynamo graph Conceptual.Adaptive K-Rationalize Deviation By SAT.dyn (Dynamo 2.13.1.3887)
# author: karam@aecedx.com
# packages: Synthesize toolkit 12.5.1

# group: Input
n10_transfer_family_to_revit = BoolSelector(false)  # "10.Transfer Family To Revit"; graph input
sat_file = Filename("No file selected.")
n01_group_adjacent_surfaces_takes = BoolSelector(false)  # "01.Group Adjacent Surfaces (Takes Time) ?"; graph input
n06_keep_already_planar_surfaces = BoolSelector(false)  # "06.Keep Already Planar Surfaces"; graph input
n03_weight_planar_goal = IntegerSlider(3, range=-1..1000 step 1)  # "03.Weight: Planar Goal"; graph input
n04_weight_original_shape_goal = IntegerSlider(1, range=-1..1000 step 1)  # "04.Weight: Original Shape Goal"; graph input
n05_weight_original_lengths_goal = IntegerSlider(1, range=-1..1000 step 1)  # "05.Weight: Original Lengths Goal"; graph input
n07_points_merge_threshold = DoubleInput(0.1)  # "07.Points Merge Threshold"; graph input
n02_iterations_attempts = IntegerSlider(100000, range=1..100000 step 1)  # "02.Iterations (Attempts)"; graph input
n08_with_momentum = BoolSelector(true)  # "08.With Momentum ?"; graph input
n09_force_planar = BoolSelector(false)  # "09.Force Planar ?"; graph input
n11_transfer_family_to_revit_use = BoolSelector(true)  # "11.Transfer Family To Revit: Use Import Instance Instead"; graph input
scale_midpoint_color = DoubleSlider(20, range=2..100 step 1)
analysis_density = IntegerSlider(5, range=3..10 step 1)

join = List.Join()  # unwired: list0, list1, list2, list3
importFromSAT = Geometry.ImportFromSAT(file=sat_file)
explode = Geometry.Explode(geometry=importFromSAT)
flatten = List.Flatten(list=explode)
code_block = CodeBlock { "Surface"; }
byClassName = Custom[SP.Filter.ByClassName](VARobject=flatten, VARclassName=code_block)  # package Synthesize toolkit; Filters a list of objects by the object's class name. Note that Dynamo elements belong to different classes than their Revit counterparts. Use the Object.Class node to check an object's class.
group_adjacent_surfaces = Custom[Group Adjacent Surfaces](VARSurfaces=byClassName.VARin, VARGroupOrNot=n01_group_adjacent_surfaces_takes)  # package Synthesize toolkit; Join Adjacent Surfaces
perimeterCurves = Surface.PerimeterCurves(surface=group_adjacent_surfaces)
startPoint = Curve.StartPoint(curve=perimeterCurves)
isPlanar = Custom[CW.Surface.IsPlanar](VARsurface=group_adjacent_surfaces@L2)  # package Synthesize toolkit; Checks whether a face is planar
code_block_2 = CodeBlock { false; }
count = List.Count(list=isPlanar@L2)
ofRepeatedItem = List.OfRepeatedItem(item=code_block_2, amount=count)
scopeIf = Custom[CW.ScopeIf+](VARtest=n06_keep_already_planar_surfaces, VARtrue=isPlanar, VARfalse=ofRepeatedItem)  # package Synthesize toolkit; A (hopefully) more robust implementation of ScopeIf. Tests a single boolean and returns a value accordingly.
filterByBoolMask = List.FilterByBoolMask(list=startPoint, mask=scopeIf)
coPlanarGoal_Create = DynaShape.ZeroTouch.Goals.CoPlanarGoal_Create(startPositions=filterByBoolMask.out, weight=n03_weight_planar_goal)
isNull = Object.IsNull(object=coPlanarGoal_Create)
filterByBoolMask_2 = List.FilterByBoolMask(list=coPlanarGoal_Create, mask=isNull)
shapeMatchingGoal_Create = DynaShape.ZeroTouch.Goals.ShapeMatchingGoal_Create(startPositions=startPoint, targetShapePoints=startPoint, weight=n04_weight_original_shape_goal)
filterByBoolMask_3 = List.FilterByBoolMask(list=group_adjacent_surfaces, mask=scopeIf)
code_block_3 = CodeBlock { 0.5; }
pointAtParameter = Surface.PointAtParameter(surface=filterByBoolMask_3.in, u=code_block_3, v=code_block_3)
normalAtParameter = Surface.NormalAtParameter(surface=filterByBoolMask_3.in, u=code_block_3, v=code_block_3)
byOriginNormal = Plane.ByOriginNormal(origin=pointAtParameter, normal=normalAtParameter)
onPlaneGoal_Create = DynaShape.ZeroTouch.Goals.OnPlaneGoal_Create(startPositions=filterByBoolMask.in@L2, targetPlane=byOriginNormal@L2, weight=n03_weight_planar_goal)
endPoint = Curve.EndPoint(curve=perimeterCurves)
byStartPointEndPoint = Line.ByStartPointEndPoint(startPoint=startPoint, endPoint=endPoint)
length = Curve.Length(curve=byStartPointEndPoint)
lengthGoal_Create = DynaShape.ZeroTouch.Goals.LengthGoal_Create(startPosition1=startPoint, startPosition2=endPoint, targetLength=length, weight=n05_weight_original_lengths_goal)
flatten_2 = List.Flatten(list=lengthGoal_Create@L3)
combine = List.Combine(combineFunction=join, list0=filterByBoolMask_2.out, list1=shapeMatchingGoal_Create, list2=onPlaneGoal_Create, list3=flatten_2)
code_block_4 = CodeBlock { true; }
polylineBinder = DynaShape.ZeroTouch.GeometryBinders.PolylineBinder(vertices=startPoint, loop=code_block_4)
metersInput = Custom[MetersInput](VARInput=n07_points_merge_threshold)  # package Synthesize toolkit; MetersInput
code_block_5 = CodeBlock { 0.000000001; }
metersInput_2 = Custom[MetersInput](VARInput=code_block_5)
code_block_6 = CodeBlock { true; }
executeSilently = DynaShape.ZeroTouch.Solver.ExecuteSilently(goals=combine, geometryBinders=polylineBinder, nodeMergeThreshold=metersInput, iterations=n02_iterations_attempts, terminationThreshold=metersInput_2, execute=code_block_6, enableMomentum=n08_with_momentum)
byPatch = Surface.ByPatch(closedCurve=executeSilently.geometries)
force_surface_to_planar = Custom[Force Surface to Planar](VARSurfaces=byPatch, VARForceOrNot=n09_force_planar)  # package Synthesize toolkit; Force Surface to Planar
empty = List.Empty()
scopeIf_2 = Custom[CW.ScopeIf+](VARtest=n10_transfer_family_to_revit, VARtrue=force_surface_to_planar.VARSurfaces, VARfalse=empty)
k_family_insert = Custom[K-Family Insert](VARGeometryorSAT=scopeIf_2, VARImportInstanceInstead=n11_transfer_family_to_revit_use)  # package Synthesize toolkit; K-Family Insert

# group: Preview
flatten_3 = List.Flatten(list=force_surface_to_planar.VARPerimeterCurves)

smart_translate_for_k = Custom[Smart Translate For K-Rationalize](VARGeometry=group_adjacent_surfaces)  # package Synthesize toolkit; Smart Translate For K-Rationalize

# group: Preview
perimeterCurves_2 = Surface.PerimeterCurves(surface=smart_translate_for_k)

surface_color_analysis_display = Custom[Surface Color Analysis Display For K-Rationalize](VAROldSurfaces=smart_translate_for_k, VARNewSurfaces=byPatch, VARScaleMidpointColor=scale_midpoint_color, VARAnalysisDensity=analysis_density)  # package Synthesize toolkit; Color Analysis Display For K-Rationalize

# group: Preview
bySurfaceColors = Modifiers.GeometryColor.BySurfaceColors(surface=surface_color_analysis_display.VARDisplayOldSurface, colors=surface_color_analysis_display.VARDisplayOldColors)
bySurfaceColors_2 = Modifiers.GeometryColor.BySurfaceColors(surface=surface_color_analysis_display.VARDisplayNewSurface, colors=surface_color_analysis_display.VARDisplayNewColors)

debug_python_no_message = Custom[Debug Python No Message]()  # package Synthesize toolkit; Debug Python
