# Dynamo graph Conceptual.Adaptive K-Rigger By Profile Selection.dyn (Dynamo 2.13.1.3887)
# author: karam@aecedx.com
# packages: Synthesize toolkit 12.5.1

# group: Input
n01_select_model_lines = DSModelElementsSelection()  # "01.Select Model Lines"; nothing selected; graph input
n07_new_x = DoubleInput(1)  # "07.New X"; graph input
n06_old_x = DoubleInput(1)  # "06.Old X"; graph input
n09_new_y = DoubleInput(1)  # "09.New Y"; graph input
n08_old_y = DoubleInput(1)  # "08.Old Y"; graph input
n10_generic_family_template = Filename("..\..\..\ProgramData\Autodesk\RVT 2020\Family Templates\English\Metric Generic Model.rft")  # "10.Generic Family Template"; graph input
n11_adaptive_family_template = Filename("..\..\..\ProgramData\Autodesk\RVT 2020\Family Templates\English\Metric Generic Model Adaptive.rft")  # "11.Adaptive Family Template"; graph input
n04_is_instance_parameters = BoolSelector(true)  # "04.Is Instance Parameters ?"; graph input
n02_profile_name = StringInput("Profile")  # "02.Profile Name"; graph input
n05_update_mode_false_will_auto = BoolSelector(false)  # "05.Update Mode - False Will Auto Increment"; graph input
n03_profile_number = DoubleInput(1)  # "03.Profile Number"; graph input

code_block = CodeBlock { "ReferencePoint"; }
byClassName = Custom[SP.Filter.ByClassName](VARobject=n01_select_model_lines, VARclassName=code_block)  # package Synthesize toolkit; Filters a list of objects by the object's class name. Note that Dynamo elements belong to different classes than their Revit counterparts. Use the Object.Class node to check an object's class.
geometry_of_model_curves_and = Custom[Geometry of Model Curves and Curve By Points](VARElements=byClassName.VARout)  # package Synthesize toolkit; Geometry and Vector of Model Curves and Curve By Points
code_block_2 = CodeBlock { false; }
clean = List.Clean(list=geometry_of_model_curves_and, preserveIndices=code_block_2)
flatten = List.Flatten(list=clean)
python_script = Python(IN[0]=byClassName.VARin, IN[1]=flatten)  # IronPython2
# ---------- python_script.python (67 lines) ----------
# Enable Python support and load DesignScript library
# IMPORTANT : ALL DYNAMO DESIGN SCRIPT NODES ARE AS (dg)
import clr
clr.AddReference('ProtoGeometry')
from Autodesk.DesignScript import Geometry as dg

# EXTENSION Enable ToDSType
clr.AddReference('RevitNodes')
import Revit
clr.ImportExtensions(Revit.Elements)

# Enable Revit Elements
from Revit.Elements import *

# EXTENSION Enable Geometry Conversion Methods
clr.ImportExtensions(Revit.GeometryConversion)

# Enable Revit API
clr.AddReference('RevitAPI')
from Autodesk.Revit.DB import *

# Enable DocumentManager and TransactionManager
clr.AddReference('RevitServices')
from RevitServices.Persistence import DocumentManager
from RevitServices.Transactions import TransactionManager

# Enable ICollection List Translate
clr.AddReference("System")
import System.Collections.Generic
from System.Collections.Generic import List

dataEnteringNode = IN
# Use UnwrapElement(IN[0]) When Translating From Dynamo to Revit
Ref=UnwrapElement(IN[0])
Curves=UnwrapElement(IN[1])

def tolist(obj1):
	if hasattr(obj1,'__iter__'): return obj1
	else: return [obj1]

def flatten(x):
    result = []
    for el in x:
        if hasattr(el, "__iter__") and not isinstance(el, basestring):
            result.extend(flatten(el))
        else:
            result.append(el)
    return result
    
# Choose The Current Document
doc = DocumentManager.Instance.CurrentDBDocument
uidoc = DocumentManager.Instance.CurrentUIApplication.ActiveUIDocument
uiapp = DocumentManager.Instance.CurrentUIApplication
app = uiapp.Application

# Create Empty List
result = []

if len(Ref) == 0 or Ref == None or Ref == []:
	bbox = dg.BoundingBox.ByGeometry(Curves)
	maxp = bbox.MaxPoint
	minp = bbox.MinPoint
	midp = dg.Curve.PointAtParameter(dg.Line.ByStartPointEndPoint(minp,maxp),0.5)
else:
	midp = flatten(tolist(Ref))[0].GetCoordinateSystem().Origin.ToPoint()
# Assign your output to the OUT variable.
OUT = midp
# ----------------------------------------
byOrigin = CoordinateSystem.ByOrigin(origin=python_script)
XYPlane = CoordinateSystem.XYPlane(coordinateSystem=byOrigin)
div = n07_new_x / n06_old_x
div_2 = n09_new_y / n08_old_y
scale = Geometry.Scale(geometry=flatten, plane=XYPlane, xamount=div, yamount=div_2, zamount=div_2, lacing=Longest)
scale_up_and_down_revit_factor = Custom[Scale Up and Down Revit Factor]()  # package Synthesize toolkit; Scale Up and Down Revit Factor
scale_2 = Geometry.Scale(geometry=scale, plane=XYPlane, xamount=scale_up_and_down_revit_factor.VARDown, yamount=scale_up_and_down_revit_factor.VARDown, zamount=scale_up_and_down_revit_factor.VARDown, lacing=Longest)
origin = Point.Origin()
byOrigin_2 = CoordinateSystem.ByOrigin(origin=origin)
transform = Geometry.Transform(geometry=scale_2, fromCoordinateSystem=byOrigin, contextCoordinateSystem=byOrigin_2, lacing=Longest)
isClosed = Curve.IsClosed(curve=transform)
filterByBoolMask = List.FilterByBoolMask(list=transform, mask=isClosed)
code_block_3 = CodeBlock { 1; }
chop = List.Chop(list=filterByBoolMask.in, lengths=code_block_3)
curves_offset_to_revit = Custom[Curves Offset To Revit Compatibility](VARCurves=chop)  # package Synthesize toolkit; Curves Offset To Revit Compatibility
mergeByBoolMask = Custom[SP.List.MergeByBoolMask](VARIn=curves_offset_to_revit.VARCurves, VAROut=filterByBoolMask.out, VARmask=isClosed)  # package Synthesize toolkit; Merge two lists by a boolean mask list. The true count in the mask should be the same as the length of the true list and vice versa for the false list.
flatten_2 = List.Flatten(list=mergeByBoolMask)
categories = Categories("OST_GenericModel")
smart_rft_path = Custom[Smart RFT Path](VARRFTFile=n10_generic_family_template, VARCategory=categories)  # package Synthesize toolkit; Smart RFT Path
categories_2 = Categories("OST_AdaptivePoints")
smart_rft_path_2 = Custom[Smart RFT Path](VARRFTFile=n11_adaptive_family_template, VARCategory=categories_2)
code_block_4 = CodeBlock { "[0-9]+"; }
categories_3 = Categories("OST_GenericModel")
all_elements_of_category = ElementsOfCategory(Category=categories_3)
get_family_and_type_name_by = Custom[Get Family and Type Name By Family Instance](VARFamilyInstance=all_elements_of_category)  # package Synthesize toolkit; Get Family and Type Name
code_block_5 = CodeBlock { "K-Rig Profile"; }
endsWith = String.EndsWith(string=get_family_and_type_name_by.VARFamilyName, searchFor=code_block_5)
code_block_6 = CodeBlock { ""; }
eq = endsWith == code_block_6
filterByBoolMask_2 = List.FilterByBoolMask(list=get_family_and_type_name_by.VARFamilyName, mask=eq)
findRegularExpression = Custom[CW.String.FindRegularExpression](VARRegEx=code_block_4, VARstr=filterByBoolMask_2.out)  # package Synthesize toolkit; Returns all occurences of a regular expression within a string (or list of strings). The syntax for regular expressions is explained at http://ironpython-test.readthedocs.org/en/latest/howto/regex.html
flatten_3 = List.Flatten(list=findRegularExpression)
toNumber = String.ToNumber(string=flatten_3)
uniqueItems = List.UniqueItems(list=toNumber)
sort = List.Sort(list=uniqueItems)
list_lastitem_fixer = Custom[List.LastItem Fixer](VARlist=sort)  # package Synthesize toolkit; List.LastItem Fixer
code_block_7 = CodeBlock { 1; }
add = list_lastitem_fixer + code_block_7
isNull = Object.IsNull(object=add)
code_block_8 = CodeBlock { 1; }
scopeIf = Custom[CW.ScopeIf+](VARtest=isNull, VARtrue=code_block_8, VARfalse=add)  # package Synthesize toolkit; A (hopefully) more robust implementation of ScopeIf. Tests a single boolean and returns a value accordingly.
scopeIf_2 = Custom[CW.ScopeIf+](VARtest=n05_update_mode_false_will_auto, VARtrue=n03_profile_number, VARfalse=scopeIf)
string_from_object = FromObject(obj=scopeIf_2)
code_block_9 = CodeBlock(a=n02_profile_name, b=string_from_object) { a+" "+b; }
k_rig_profile = Custom[K-Rig Profile](VARProfile=flatten_2, VARGenricModelTemplatePath=smart_rft_path, VARGenricModelAdaptiveTemplatePath=smart_rft_path_2, VARIsInstance=n04_is_instance_parameters, VARFamilyName=code_block_9)  # package Synthesize toolkit; K-Rig Profile
debug_python_no_message = Custom[Debug Python No Message]()  # package Synthesize toolkit; Debug Python
