# Dynamo graph Conceptual.Adaptive K-Super Borders Paneling.dyn (Dynamo 2.13.1.3887)
# author: karam@aecedx.com
# packages: Synthesize toolkit 12.5.1

# group: Input
n07_adaptive_secondary_family = FamilyTypes()  # "07.Adaptive Secondary Family"; nothing selected; graph input
n12_proceed = BoolSelector(false)  # "12.Proceed ?"; graph input
n03_points_rotation_degree = DoubleInput(0)  # "03.Points Rotation Degree"; graph input
n02_points_offset = DoubleInput(0)  # "02.Points Offset"; graph input
flip = BoolSelector(false)  # "11.Flip"; graph input
n08_adaptive_tertiary_family = FamilyTypes()  # "08.Adaptive Tertiary Family"; nothing selected; graph input
n06_adaptive_primary_family = FamilyTypes()  # "06.Adaptive Primary Family"; nothing selected; graph input
n09_adaptive_quaternary_family = FamilyTypes()  # "09.Adaptive Quaternary Family"; nothing selected; graph input
n10_adaptive_quinary_family = FamilyTypes()  # "10.Adaptive Quinary Family"; nothing selected; graph input
n01_select_divided_surfaces = SelectFaces()  # "01.Select Divided Surfaces"; nothing selected; graph input
n04_points_tollerance = DoubleInput(0.2)  # "04.Points Tollerance"; graph input
n05_border_detection_tollerance = DoubleInput(1)  # "05.Border Detection Tollerance"; graph input

k_super_boders_paneling = Custom[K-Super Boders Paneling](VARSecondaryType=n07_adaptive_secondary_family, VARProceed=n12_proceed, VARRotationDegree=n03_points_rotation_degree, VARAdaptivePointsOffset=n02_points_offset, VARFlip=flip, VARTertiaryType=n08_adaptive_tertiary_family, VARPrimaryType=n06_adaptive_primary_family, VARQuaternaryType=n09_adaptive_quaternary_family, VARQuinaryType=n10_adaptive_quinary_family, VARTargetSurfaces=n01_select_divided_surfaces, VARTollerance=n04_points_tollerance, VARBorderDetectionTollerance=n05_border_detection_tollerance)  # package Synthesize toolkit; K-Super Map Revit Paneling - Custom

# group: Result
report = Watch(k_super_boders_paneling.VARReport)  # "01.Report"; graph output

# group: Result
n02_accepted_primary_panels = Watch(k_super_boders_paneling.VARAcceptedPrimaryPanels)  # "02.Accepted Primary Panels/Adaptive Components Number"; graph output
n03_rejected_primary_panels = Watch(k_super_boders_paneling.VARRejectedPrimaryPanels)  # "03.Rejected Primary Panels/Adaptive Components Number"; graph output

# group: Result
n04_accepted_secondary_panels = Watch(k_super_boders_paneling.VARAcceptedSecondaryPanels)  # "04.Accepted Secondary Panels/Adaptive Components Number"; graph output
n05_rejected_secondary_panels = Watch(k_super_boders_paneling.VARRejectedSecondaryPanels)  # "05.Rejected Secondary Panels/Adaptive Components Number"; graph output

# group: Result
n06_accepted_tertiary_panels = Watch(k_super_boders_paneling.VARAcceptedTertiaryPanels)  # "06.Accepted Tertiary Panels/Adaptive Components Number"; graph output
n07_rejected_tertiary_panels = Watch(k_super_boders_paneling.VARRejectedTertiaryPanels)  # "07.Rejected Tertiary Panels/Adaptive Components Number"; graph output

# group: Result
n08_accepted_quaternary_panels = Watch(k_super_boders_paneling.VARAcceptedQuaternaryPanels)  # "08.Accepted Quaternary Panels/Adaptive Components Number"; graph output
n09_rejected_quaternary_panels = Watch(k_super_boders_paneling.VARRejectedQuaternaryPanels)  # "09.Rejected Quaternary Panels/Adaptive Components Number"; graph output

# group: Result
n10_accepted_quinary_panels = Watch(k_super_boders_paneling.VARAcceptedQuinaryPanels)  # "10.Accepted Quinary Panels/Adaptive Components Number"; graph output
n11_rejected_quinary_panels = Watch(k_super_boders_paneling.VARRejectedQuinaryPanels)  # "11.Rejected Quinary Panels/Adaptive Components Number"; graph output

debug_python = Custom[Debug Python]()  # package Synthesize toolkit; Debug Python
