# Dynamo graph Conceptual.Adaptive K-Super Diamond Multiface (Rhomboid) Paneling.dyn (Dynamo 2.13.1.3887)
# author: karam@aecedx.com
# packages: Synthesize toolkit 12.5.1

# group: Input
n10_adaptive_4_points_type_1 = FamilyTypes()  # "10.Adaptive 4 Points Type 1 Family"; nothing selected; graph input
n13_proceed = BoolSelector(false)  # "13.Proceed ?"; graph input
n08_points_rotation_degree = DoubleInput(0)  # "08.Points Rotation Degree"; graph input
n07_points_offset = DoubleInput(0)  # "07.Points Offset"; graph input
flip = BoolSelector(false)  # "12.Flip"; graph input
n11_adaptive_4_points_type_2 = FamilyTypes()  # "11.Adaptive 4 Points Type 2 Family"; nothing selected; graph input
n09_adaptive_3_points_family = FamilyTypes()  # "09.Adaptive 3 Points Family"; nothing selected; graph input
n05_u_grid = DoubleInput(2)  # "05.U Grid"; graph input
n06_v_grid = DoubleInput(2)  # "06.V Grid"; graph input
n01_select_faces = SelectFaces()  # "01.Select Faces"; nothing selected; graph input
n03_fetch_whole_body = BoolSelector(false)  # "03.Fetch Whole Body ?"; graph input
n04_faces_filter_1_vertical_faces = IntegerSlider(4, range=1..4 step 1)  # "04.Faces Filter (1 = Vertical Faces | 2 = Horizontal Up Faces | 3 = Horizontal Down Faces | 4 = All Faces)"; graph input
n02_sat_file_if_found_selected = StringInput("D:\Exported Loft.sat")  # "02.SAT File (If Found, Selected Target Faces Will Be Ignored)"; graph input

code_block = CodeBlock { true; }
all_surfaces_or_surface = Custom[All Surfaces or Surface Filtering](VARSurfaces=n01_select_faces, VARFetchWholeBody=n03_fetch_whole_body, VAROrienataion=n04_faces_filter_1_vertical_faces, VARBruteForceGeometryReferencesWillNotWork=code_block)  # package Synthesize toolkit; All Surfaces or Surface Filtering
k_super_diamond_revit_paneling = Custom[K-Super Diamond Revit Paneling - Multiface](VAR4PointsType1=n10_adaptive_4_points_type_1, VARProceed=n13_proceed, VARRotationDegree=n08_points_rotation_degree, VARAdaptivePointsOffset=n07_points_offset, VARFlip=flip, VAR4PointsType2=n11_adaptive_4_points_type_2, VAR3PointsType=n09_adaptive_3_points_family, VARUGrid=n05_u_grid, VARVGrid=n06_v_grid, VARTargetSurfaces=all_surfaces_or_surface.VARDynamoFace, VARSATFile=n02_sat_file_if_found_selected)  # package Synthesize toolkit; K-Super Map Revit Paneling - Custom

# group: Result
n01_accepted_3_points_panels = Watch(k_super_diamond_revit_paneling.VARAccepted3PointsPanels)  # "01.Accepted 3 Points Panels Components Number"; graph output
n02_rejected_3_points_panels = Watch(k_super_diamond_revit_paneling.VARRejected3PointsPanels)  # "02.Rejected 3 Points Panels Components Number"; graph output

# group: Result
n03_accepted_4_points_type_1 = Watch(k_super_diamond_revit_paneling.VARAccepted4PointsType1Panels)  # "03.Accepted 4 Points Type 1 Panels Components Number"; graph output
n04_rejected_4_points_type_1 = Watch(k_super_diamond_revit_paneling.VARRejected4PointsType1Panels)  # "04.Rejected 4 Points Type 1 Panels Components Number"; graph output

# group: Result
n05_accepted_4_points_type_2 = Watch(k_super_diamond_revit_paneling.VARAccepted4PointsType2Panels)  # "05.Accepted 4 Points Type 2 Panels Components Number"; graph output
n06_rejected_4_points_type_2 = Watch(k_super_diamond_revit_paneling.VARRejected4PointsType2Panels)  # "06.Rejected 4 Points Type 2 Panels Components Number"; graph output

debug_python = Custom[Debug Python]()  # package Synthesize toolkit; Debug Python
