# Dynamo graph Conceptual.Adaptive K-Super Geodesic Paneling.dyn (Dynamo 2.13.1.3887)
# author: karam@aecedx.com
# packages: Synthesize toolkit 12.5.1

# group: Input
n01_select_dome = DSFaceSelection()  # "01.Select Dome"; nothing selected; graph input
n03_dome_method_upper_dome_1 = IntegerSlider(1, range=1..3 step 1)  # "03.Dome Method : Upper Dome = 1 | Downer Dome = 2 | Full Sphere = 3"; graph input
n04_dome_rotation_degree = DoubleInput(0)  # "04.Dome Rotation Degree"; graph input
n09_adaptive_family = FamilyTypes()  # "09.Adaptive Family"; nothing selected; graph input
n11_proceed = BoolSelector(false)  # "11.Proceed ?"; graph input
n05_points_offset = DoubleInput(0)  # "05.Points Offset"; graph input
flip = BoolSelector(false)  # "10.Flip"; graph input
intensity = DoubleInput(3)  # "02.Intensity"; graph input
n06_x_scale = DoubleInput(1)  # "06.X Scale"; graph input
n07_y_scale = DoubleInput(1)  # "07.Y Scale"; graph input
n08_z_scale = DoubleInput(1)  # "08.Z Scale"; graph input

code_block = CodeBlock { 2022; }
update_revit_wait = Custom[Update Revit Wait](VARWait=n01_select_dome, VARVersion=code_block)  # package Synthesize toolkit; Update Revit Wait
points_rotation_degree = DoubleInput(0)
k_super_geodesic_master_paneling = Custom[K-Super Geodesic Master Paneling](VARDomeFace=update_revit_wait, VARDomeMethodUpperDome1DownerDome2FullSphere3=n03_dome_method_upper_dome_1, VARRotationDegrees=n04_dome_rotation_degree, VARFamilyType=n09_adaptive_family, VARProceed=n11_proceed, VARRotationDegree=points_rotation_degree, VARAdaptivePointsOffset=n05_points_offset, VARFlip=flip, VARIntensity=intensity, VARXScale=n06_x_scale, VARYScale=n07_y_scale, VARZScale=n08_z_scale)  # package Synthesize toolkit; K-Supe Geodesic Master Paneling
debug_python_no_message = Custom[Debug Python No Message]()  # package Synthesize toolkit; Debug Python
