# Dynamo graph Conceptual.Adaptive K-Super Honeycombs Paneling.dyn (Dynamo 2.13.1.3887)
# author: karam@aecedx.com
# packages: Synthesize toolkit 12.5.1

# group: Input
n04_sat_file_if_found_selected = StringInput("D:\Exported Loft.sat")  # "04.SAT File (If Found, Selected Faces Will Be Ignored)"; graph input
n01_select_faces = SelectFaces()  # "01.Select Faces"; nothing selected; graph input
n02_fetch_whole_body = BoolSelector(false)  # "02.Fetch Whole Body ?"; graph input
n03_faces_filter_1_vertical_faces = IntegerSlider(4, range=1..4 step 1)  # "03.Faces Filter (1 = Vertical Faces | 2 = Horizontal Up Faces | 3 = Horizontal Down Faces | 4 = All Faces)"; graph input
n13_proceed = BoolSelector(false)  # "13.Proceed ?"; graph input
n06_v_grid = DoubleInput(3)  # "06.V Grid"; graph input
n05_u_grid = DoubleInput(5)  # "05.U Grid"; graph input
n09_adaptive_triangular_family = FamilyTypes()  # "09.Adaptive Triangular Family"; nothing selected; graph input
n08_points_rotation_degree = DoubleInput(0)  # "08.Points Rotation Degree"; graph input
n07_points_offset = DoubleInput(0)  # "07.Points Offset"; graph input
flip = BoolSelector(false)  # "12.Flip"; graph input
n10_adaptive_quad_family = FamilyTypes()  # "10.Adaptive Quad Family"; nothing selected; graph input
n11_adaptive_hexagonal_family = FamilyTypes()  # "11.Adaptive Hexagonal Family"; nothing selected; graph input

code_block = CodeBlock { true; }
all_surfaces_or_surface = Custom[All Surfaces or Surface Filtering](VARSurfaces=n01_select_faces, VARFetchWholeBody=n02_fetch_whole_body, VAROrienataion=n03_faces_filter_1_vertical_faces, VARBruteForceGeometryReferencesWillNotWork=code_block)  # package Synthesize toolkit; All Surfaces or Surface Filtering
k_super_honeycombs_paneling = Custom[K-Super Honeycombs Paneling](VARSATFile=n04_sat_file_if_found_selected, VARSurfaces=all_surfaces_or_surface.VARDynamoFace, VARProceed=n13_proceed, VARU=n06_v_grid, VARV=n05_u_grid, VARTriangularType=n09_adaptive_triangular_family, VARRotationDegree=n08_points_rotation_degree, VARAdaptivePointsOffset=n07_points_offset, VARFlip=flip, VARQuadType=n10_adaptive_quad_family, VARHexagonalType=n11_adaptive_hexagonal_family)  # package Synthesize toolkit; K-Super Honeycombs Paneling

# group: Result
n01_accepted_triangular_panels = Watch(k_super_honeycombs_paneling.VARAcceptedTriangularPanels)  # "01.Accepted Triangular Panels/Adaptive Components Number"; graph output
n02_rejected_triangular_panels = Watch(k_super_honeycombs_paneling.VARRejectedTriangularPanels)  # "02.Rejected Triangular Panels/Adaptive Components Number"; graph output

# group: Result
n03_accepted_quad_panels_adaptive = Watch(k_super_honeycombs_paneling.VARAcceptedQuadPanels)  # "03.Accepted Quad Panels/Adaptive Components Number"; graph output
n04_rejected_quad_panels_adaptive = Watch(k_super_honeycombs_paneling.VARRejectedQuadPanels)  # "04.Rejected Quad Panels/Adaptive Components Number"; graph output

# group: Result
n05_accepted_hexagonal_panels = Watch(k_super_honeycombs_paneling.VARAcceptedHexagonalPanels)  # "05.Accepted Hexagonal Panels/Adaptive Components Number"; graph output
n06_rejected_hexagonal_corner = Watch(k_super_honeycombs_paneling.VARRejectedHexagonalPanels)  # "06.Rejected Hexagonal Corner Panels/Adaptive Components Number"; graph output

debug_python = Custom[Debug Python]()  # package Synthesize toolkit; Debug Python
