# Dynamo graph Conceptual.Adaptive K-Super Outlines of Faces Paneling.dyn (Dynamo 2.13.1.3887)
# author: karam@aecedx.com
# packages: Synthesize toolkit 12.5.1

# group: Input
n04_sat_file_if_found_selected = StringInput("D:\Exported Loft.sat")  # "04.SAT File (If Found, Selected Faces Will Be Ignored)"; graph input
n01_select_faces = SelectFaces()  # "01.Select Faces"; nothing selected; graph input
n02_fetch_whole_body = BoolSelector(false)  # "02.Fetch Whole Body ?"; graph input
n03_faces_filter_1_vertical_faces = IntegerSlider(4, range=1..4 step 1)  # "03.Faces Filter (1 = Vertical Faces | 2 = Horizontal Up Faces | 3 = Horizontal Down Faces | 4 = All Faces)"; graph input
n07_adaptive_family = FamilyTypes()  # "07.Adaptive Family"; nothing selected; graph input
n06_points_rotation_degree = DoubleInput(0)  # "06.Points Rotation Degree"; graph input
n05_points_offset = DoubleInput(0)  # "05.Points Offset"; graph input
flip = BoolSelector(false)  # "08.Flip"; graph input

code_block = CodeBlock { true; }
all_surfaces_or_surface = Custom[All Surfaces or Surface Filtering](VARSurfaces=n01_select_faces, VARFetchWholeBody=n02_fetch_whole_body, VAROrienataion=n03_faces_filter_1_vertical_faces, VARBruteForceGeometryReferencesWillNotWork=code_block)  # package Synthesize toolkit; All Surfaces or Surface Filtering
k_super_faces_outlines_paneling = Custom[K-Super Faces Outlines Paneling](VARSATFile=n04_sat_file_if_found_selected, VARSurfaces=all_surfaces_or_surface.VARDynamoFace, VARFamilyType=n07_adaptive_family, VARRotationDegree=n06_points_rotation_degree, VARAdaptivePointsOffset=n05_points_offset, VARFlip=flip)  # package Synthesize toolkit; K-Super Quad Master Paneling
debug_python = Custom[Debug Python]()  # package Synthesize toolkit; Debug Python
