# Dynamo graph Conceptual.Adaptive K-Super Triangle Diagonal Paneling.dyn (Dynamo 2.13.1.3887)
# author: karam@aecedx.com
# packages: Synthesize toolkit 12.5.1

# group: Input
n04_sat_file_if_found_selected = StringInput("D:\Exported Loft.sat")  # "04.SAT File (If Found, Selected Faces Will Be Ignored)"; graph input
n01_select_faces = SelectFaces()  # "01.Select Faces"; nothing selected; graph input
n02_fetch_whole_body = BoolSelector(false)  # "02.Fetch Whole Body ?"; graph input
n03_faces_filter_1_vertical_faces = IntegerSlider(4, range=1..4 step 1)  # "03.Faces Filter (1 = Vertical Faces | 2 = Horizontal Up Faces | 3 = Horizontal Down Faces | 4 = All Faces)"; graph input
n06_v_grid = DoubleInput(10)  # "06.V Grid"; graph input
n10_reverse_type_a = BoolSelector(false)  # "10.Reverse Type A"; graph input
n13_reverse_type_b = BoolSelector(false)  # "13.Reverse Type B"; graph input
n11_shift_type_a_placement = DoubleInput(0)  # "11.Shift Type A Placement"; graph input
n14_shift_type_b_placement = DoubleInput(0)  # "14.Shift Type B Placement"; graph input
n15_shift_overall_placement = DoubleInput(0)  # "15.Shift Overall Placement"; graph input
n16_rotate_grid_90_degrees = BoolSelector(false)  # "16.Rotate Grid 90 Degrees ?"; graph input
n05_u_grid = DoubleInput(10)  # "05.U Grid"; graph input
n18_proceed = BoolSelector(false)  # "18.Proceed ?"; graph input
n09_adaptive_triangular_family = FamilyTypes()  # "09.Adaptive Triangular Family - Type A"; nothing selected; graph input
n08_points_rotation_degree = DoubleInput(0)  # "08.Points Rotation Degree"; graph input
n07_points_offset = DoubleInput(0)  # "07.Points Offset"; graph input
flip = BoolSelector(false)  # "17.Flip"; graph input
n12_adaptive_triangular_family = FamilyTypes()  # "12.Adaptive Triangular Family - Type B"; nothing selected; graph input

code_block = CodeBlock { true; }
all_surfaces_or_surface = Custom[All Surfaces or Surface Filtering](VARSurfaces=n01_select_faces, VARFetchWholeBody=n02_fetch_whole_body, VAROrienataion=n03_faces_filter_1_vertical_faces, VARBruteForceGeometryReferencesWillNotWork=code_block)  # package Synthesize toolkit; All Surfaces or Surface Filtering
k_super_triangle_diagonal = Custom[K-Super Triangle Diagonal Paneling](VARSATFile=n04_sat_file_if_found_selected, VARSurfaces=all_surfaces_or_surface.VARDynamoFace, VARV=n06_v_grid, VARreverseTypeA=n10_reverse_type_a, VARreverseTypeB=n13_reverse_type_b, VARshiftPlacementTypeA=n11_shift_type_a_placement, VARshiftPlacementTypeB=n14_shift_type_b_placement, VARshiftOverallPlacement=n15_shift_overall_placement, VARrotateGridBy90Degrees=n16_rotate_grid_90_degrees, VARU=n05_u_grid, VARProceed=n18_proceed, VARAType=n09_adaptive_triangular_family, VARRotationDegree=n08_points_rotation_degree, VARAdaptivePointsOffset=n07_points_offset, VARFlip=flip, VARBType=n12_adaptive_triangular_family)  # package Synthesize toolkit; K-Super Triangle Diagonal Paneling

# group: Result
n01_accepted_triangular_a_panels = Watch(k_super_triangle_diagonal.VARAcceptedATriangular)  # "01.Accepted Triangular A Panels/Adaptive Components Number"; graph output
n02_rejected_triangular_a_panels = Watch(k_super_triangle_diagonal.VARRejectedATriangular)  # "02.Rejected Triangular A Panels/Adaptive Components Number"; graph output

# group: Result
n03_accepted_triangular_b_panels = Watch(k_super_triangle_diagonal.VARAcceptedBTriangular)  # "03.Accepted Triangular B Panels/Adaptive Components Number"; graph output
n04_rejected_triangular_b_panels = Watch(k_super_triangle_diagonal.VARRejectedBTriangular)  # "04.Rejected Triangular B Panels/Adaptive Components Number"; graph output

debug_python = Custom[Debug Python]()  # package Synthesize toolkit; Debug Python
