# Dynamo graph Conceptual.Adaptive Misc Extract Surfaces.dyn (Dynamo 2.13.1.3887)
# author: karam@aecedx.com
# packages: Synthesize toolkit 12.5.1

debug_python_no_message = Custom[Debug Python No Message]()  # package Synthesize toolkit; Debug Python

# group: Input
n03_generate_sat_file_only = BoolSelector(false)  # "03.Generate SAT File Only ?"; graph input
n01_select_adaptive_components = DSModelElementsSelection()  # "01.Select Adaptive Components"; nothing selected; graph input
n02_group_adaject_families_takes = BoolSelector(false)  # "02.Group Adaject Families (Takes Time)"; graph input
n04_sat_file_export_path = StringInput("D:\Dynamo Adaptive Surfaces.sat")  # "04.SAT File Export Path"; graph input

empty = List.Empty()
filter_adaptive_component = Custom[Filter Adaptive Component FamilyInstances](VARFamilyInstances=n01_select_adaptive_components)  # package Synthesize toolkit; Filter Adaptive Component FamilyInstances
code_block = CodeBlock { true; }
location_of_any_element = Custom[Location Of Any Element](VARElements=filter_adaptive_component, VARGetAllPointsOfAdaptiveComponents=code_block)  # package Synthesize toolkit; Location Of Any Element
byPoints = Polygon.ByPoints(points=location_of_any_element.VARLocations)
explode = Geometry.Explode(geometry=byPoints)
byJoinedCurves = PolyCurve.ByJoinedCurves(curves=explode)
byAngle = Custom[CurveLoop.Simplify.ByAngle](VARPolycurves=byJoinedCurves)  # package Synthesize toolkit; CurveLoop.Simplify.ByAngle
byPatch = Surface.ByPatch(closedCurve=byAngle)
group_adjacent_surfaces = Custom[Group Adjacent Surfaces](VARSurfaces=byPatch, VARGroupOrNot=n02_group_adaject_families_takes)  # package Synthesize toolkit; Join Adjacent Surfaces
scopeIf = Custom[CW.ScopeIf+](VARtest=n03_generate_sat_file_only, VARtrue=empty, VARfalse=group_adjacent_surfaces)  # package Synthesize toolkit; A (hopefully) more robust implementation of ScopeIf. Tests a single boolean and returns a value accordingly.
k_family_insert = Custom[K-Family Insert](VARGeometryorSAT=scopeIf@L2)  # package Synthesize toolkit; K-Family Insert
empty_2 = List.Empty()
scopeIf_2 = Custom[CW.ScopeIf+](VARtest=n03_generate_sat_file_only, VARtrue=group_adjacent_surfaces, VARfalse=empty_2)
geometry_exporttosat_fixer = Custom[Geometry.ExportToSAT Fixer](VARgeometry=scopeIf_2, VARfilePath=n04_sat_file_export_path)  # package Synthesize toolkit; Geometry.ExportToSAT Fixer
