# Dynamo graph Conceptual.Adaptive Misc Match Coordinates.dyn (Dynamo 2.13.1.3887)
# author: karam@aecedx.com
# packages: Synthesize toolkit 12.5.1

# group: Input
n01_select_adaptive_components = DSModelElementsSelection()  # "01.Select Adaptive Components"; nothing selected; graph input
n02_snapping_tollerance_in = DoubleInput(10)  # "02.Snapping Tollerance (In Millimeters)"; graph input
n03_keep_same_positions = BoolSelector(false)  # "03.Keep Same Positions"; graph input

adaptive_match_coordination = Custom[Adaptive Match Coordination](VARElements=n01_select_adaptive_components, VARSnappingTolleranceInMeters=n02_snapping_tollerance_in, VARKeepSamePositions=n03_keep_same_positions)  # package Synthesize toolkit; Adaptive Match Coordination
debug_python_no_message = Custom[Debug Python No Message]()  # package Synthesize toolkit; Debug Python
