# Dynamo graph Conceptual.Adaptive Misc Visible Points Select.dyn (Dynamo 2.13.1.3887)
# author: karam@aecedx.com
# packages: Synthesize toolkit 12.5.1

categories = Categories("OST_AdaptivePoints")
all_elements_of_category = ElementsOfCategory(Category=categories)
python_all_elements_in_active = Custom[Python All Elements In Active View]()  # package Synthesize toolkit; Python All Elements In Active View
python_filter_list_from_another = Custom[Python Filter List From Another List](VARItemsToFilter=all_elements_of_category, VARAllItemsToFilterFrom=python_all_elements_in_active)  # package Synthesize toolkit; Find Intersections In Lists
flatten = List.Flatten(list=python_filter_list_from_another)
hot_select_in_revit = Custom[HOT.Select in Revit](VARElement=flatten)  # package Synthesize toolkit; Select Elements in Revit
count = List.Count(list=flatten)

# group: Report
n01_number_of_points = Watch(count)  # "01.Number of Points"; graph output

debug_python = Custom[Debug Python]()  # package Synthesize toolkit; Debug Python
