# Dynamo graph Conceptual.Adaptive Placement By Circle or Ellipse.dyn (Dynamo 2.13.1.3887)
# author: karam@aecedx.com
# packages: Synthesize toolkit 12.5.1

# group: Input
n01_select_circle_ellipse = DSModelElementSelection()  # "01.Select Circle/Ellipse"; nothing selected; graph input
n02_2_points_adaptive_family = FamilyTypes()  # "02.2 Points Adaptive Family"; nothing selected; graph input
n03_number_of_lights = DoubleInput(7)  # "03.Number of Lights"; graph input

adaptive_component_by_circle_or = Custom[Adaptive Component By Circle or Ellipse](VARelement=n01_select_circle_ellipse, VARfamilyType=n02_2_points_adaptive_family, VARNumberOfElements=n03_number_of_lights)  # package Synthesize toolkit; Adaptive Component By Circle/Ellipse
debug_python = Custom[Debug Python]()  # package Synthesize toolkit; Debug Python
