# Dynamo graph Conceptual.Adaptive Placement By Curves Start End.dyn (Dynamo 2.13.1.3887)
# author: karam@aecedx.com
# packages: Synthesize toolkit 12.5.1

debug_python_no_message = Custom[Debug Python No Message]()  # package Synthesize toolkit; Debug Python

# group: Input
n01_select_curves = DSModelElementsSelection()  # "01.Select Curves"; nothing selected; graph input
n04_adaptive_family = FamilyTypes()  # "04.Adaptive Family"; nothing selected; graph input
n02_host_on_points_instead = BoolSelector(false)  # "02.Host On Points Instead ?"; graph input
n03_number_of_adaptive_points_per = DoubleInput(2)  # "03.Number of Adaptive Points Per Line"; graph input

python_script = Python(IN[0]=n01_select_curves, IN[1]=n04_adaptive_family, IN[2]=n02_host_on_points_instead)  # IronPython2
# ---------- python_script.python (59 lines) ----------
# Created By Karam Baki: karam@aecedx.com
import clr
clr.AddReference('RevitNodes')
import Revit
clr.ImportExtensions(Revit.Elements)

# Enable Revit API
clr.AddReference('RevitAPI')
from Autodesk.Revit.DB import *

# Enable DocumentManager and TransactionManager
clr.AddReference('RevitServices')
from RevitServices.Persistence import DocumentManager
from RevitServices.Transactions import TransactionManager

clr.AddReference("RevitAPIUI")
from Autodesk.Revit.UI import TaskDialog

doc = DocumentManager.Instance.CurrentDBDocument
uidoc = DocumentManager.Instance.CurrentUIApplication.ActiveUIDocument
uiapp = DocumentManager.Instance.CurrentUIApplication
app = uiapp.Application

curves=UnwrapElement(IN[0])
famtype=UnwrapElement(IN[1])
go=IN[2]

if go:
	checked = []
	for c in curves:
		if c.ToString() == "Autodesk.Revit.DB.CurveByPoints":
			checked.append(c)
	
	if len(checked) == 0:
		OUT = TaskDialog.Show("AECedx - Karam", "No Points Detected")
	
	else:
		curves = checked
		result = []
		TransactionManager.Instance.EnsureInTransaction(doc)
		for c in curves:
			existedpts = c.GetPoints()
			existedplacement = []
			for existedpt in existedpts:
				ref = existedpt.GetCoordinatePlaneReferenceXY()
				existedplacement.append(app.Create.NewPointRelativeToPoint(Reference(existedpt)))
			adapt = AdaptiveComponentInstanceUtils.CreateAdaptiveComponentInstance(doc,famtype)
			pts = AdaptiveComponentInstanceUtils.GetInstancePointElementRefIds(adapt)
			elempts = []
			count = 0
			for p in pts:
				refpt = doc.GetElement(p)
				refpt.SetPointElementReference(existedplacement[count])
				count += 1
			result.append(adapt)
		TransactionManager.Instance.TransactionTaskDone()
		OUT = curves
else:
	OUT = "Nothing to Do"
# ----------------------------------------
sequence = Sequence(amount=n03_number_of_adaptive_points_per, lacing=Longest)
code_block = CodeBlock { 0; 1; }
remapRange = Math.RemapRange(numbers=sequence, newMin=code_block.out0, newMax=code_block.out1)
empty = List.Empty()
scopeIf = Custom[CW.ScopeIf+](VARtest=n02_host_on_points_instead, VARtrue=empty, VARfalse=n01_select_curves)  # package Synthesize toolkit; A (hopefully) more robust implementation of ScopeIf. Tests a single boolean and returns a value accordingly.
curves = Element.Curves(element=scopeIf)
code_block_2 = CodeBlock { false; }
clean = List.Clean(list=curves, preserveIndices=code_block_2)
flatten = List.Flatten(list=clean)
adaptivecomponent = Custom[AdaptiveComponent.ByParametersOnCurveReference Fixer](parameters=remapRange, curve=flatten, familyType=n04_adaptive_family)  # package Synthesize toolkit; AdaptiveComponent.ByParametersOnCurveReference Fixer
