# Dynamo graph Conceptual.Adaptive Placement By Curves.dyn (Dynamo 2.13.1.3887)
# author: karam@aecedx.com
# packages: Synthesize toolkit 12.5.1

# group: Input
n04_adaptive_family = FamilyTypes()  # "04.Adaptive Family"; nothing selected; graph input
n05_adaptive_flip_parameter = BoolSelector(false)  # "05.Adaptive Flip Parameter ?"; graph input
n09_reverse_placement_direction = BoolSelector(false)  # "09.Reverse Placement Direction ?"; graph input
n08_z_always_up = BoolSelector(false)  # "08.Z Always Up ?"; graph input
n01_select_curves = DSModelElementsSelection()  # "01.Select Curves"; nothing selected; graph input
spacing = DoubleInput(5)  # "02.Spacing"; graph input
n06_adaptive_point_rotation = DoubleInput(0)  # "06.Adaptive Point Rotation Degree (By X Axis)"; graph input
n03_minimum_adaptive_components = DoubleInput(3)  # "03.Minimum Adaptive Components Per Line"; graph input
n07_adaptive_point_rotation = DoubleInput(0)  # "07.Adaptive Point Rotation Degree (By Z Axis)"; graph input

curves = Element.Curves(element=n01_select_curves)
flatten = List.Flatten(list=curves)
coordinate_system_adaptive = Custom[Coordinate System Adaptive Curves Prepare](VARCurves=flatten, VARSpacing=spacing, VARRotationDegree=n06_adaptive_point_rotation, VARMinimumNumber=n03_minimum_adaptive_components)  # package Synthesize toolkit; Coordinate System Adaptive Curves Prepare
k_super_adaptive_paneling = Custom[K-Super Adaptive Paneling](VARFamilyType=n04_adaptive_family, VARFlip=n05_adaptive_flip_parameter, VARReversePlacementDirection=n09_reverse_placement_direction, VARZAlwaysUp=n08_z_always_up, VARCoordinateSystem=coordinate_system_adaptive, VARDegreesZAxis=n07_adaptive_point_rotation)  # package Synthesize toolkit; K-Super Adaptive Paneling
debug_python = Custom[Debug Python]()  # package Synthesize toolkit; Debug Python
