# Dynamo graph Conceptual.Adaptive Placement By Divided Paths.dyn (Dynamo 2.13.1.3887)
# author: karam@aecedx.com
# packages: Synthesize toolkit 12.5.1

# group: Input
n02_adaptive_family = FamilyTypes()  # "02.Adaptive Family"; nothing selected; graph input
n03_adaptive_flip_parameter = BoolSelector(false)  # "03.Adaptive Flip Parameter ?"; graph input
n07_reverse_placement_direction = BoolSelector(false)  # "07.Reverse Placement Direction ?"; graph input
n06_z_always_up = BoolSelector(false)  # "06.Z Always Up ?"; graph input
n01_select_divided_paths = DSModelElementsSelection()  # "01.Select Divided Paths"; nothing selected; graph input
n04_adaptive_point_rotation = DoubleInput(0)  # "04.Adaptive Point Rotation Degree (By X Axis)"; graph input
n05_adaptive_point_rotation = DoubleInput(0)  # "05.Adaptive Point Rotation Degree (By Z Axis)"; graph input

coordinate_system_adaptive = Custom[Coordinate System Adaptive Divided Path Prepare](VARDividedPaths=n01_select_divided_paths, VARRotationDegree=n04_adaptive_point_rotation)  # package Synthesize toolkit; Coordinate System Adaptive Divided Path Prepare
k_super_adaptive_paneling = Custom[K-Super Adaptive Paneling](VARFamilyType=n02_adaptive_family, VARFlip=n03_adaptive_flip_parameter, VARReversePlacementDirection=n07_reverse_placement_direction, VARZAlwaysUp=n06_z_always_up, VARCoordinateSystem=coordinate_system_adaptive, VARDegreesZAxis=n05_adaptive_point_rotation)  # package Synthesize toolkit; K-Super Adaptive Paneling
debug_python_no_message = Custom[Debug Python No Message]()  # package Synthesize toolkit; Debug Python
