# Dynamo graph Conceptual.Adaptive Placement By Egdes Start End.dyn (Dynamo 2.13.1.3887)
# author: karam@aecedx.com
# packages: Synthesize toolkit 12.5.1

debug_python = Custom[Debug Python]()  # package Synthesize toolkit; Debug Python

# group: Input
n02_number_of_adaptive_points_per = DoubleInput(2)  # "02.Number of Adaptive Points Per Line"; graph input
n01_select_edges = SelectEdges()  # "01.Select Edges"; nothing selected; graph input
n03_adaptive_family = FamilyTypes()  # "03.Adaptive Family"; nothing selected; graph input

sequence = Sequence(amount=n02_number_of_adaptive_points_per, lacing=Longest)
code_block = CodeBlock { 0; 1; }
remapRange = Math.RemapRange(numbers=sequence, newMin=code_block.out0, newMax=code_block.out1)
flatten = List.Flatten(list=n01_select_edges)
byParametersOnCurveReference = AdaptiveComponent.ByParametersOnCurveReference(parameters=remapRange, curve=flatten, familyType=n03_adaptive_family)
