# Dynamo graph Conceptual.Adaptive Placement By Points.dyn (Dynamo 2.13.1.3887)
# author: karam@aecedx.com
# packages: Synthesize toolkit 12.5.1

# group: Input
n02_adaptive_family = FamilyTypes()  # "02.Adaptive Family"; nothing selected; graph input
n03_adaptive_flip_parameter = BoolSelector(false)  # "03.Adaptive Flip Parameter ?"; graph input
n06_reverse_placement_direction = BoolSelector(false)  # "06.Reverse Placement Direction ?"; graph input
n05_z_always_up = BoolSelector(false)  # "05.Z Always Up ?"; graph input
n01_select_points = DSModelElementsSelection()  # "01.Select Points"; nothing selected; graph input
n04_adaptive_point_rotation = DoubleInput(0)  # "04.Adaptive Point Rotation Degree (By Z Axis)"; graph input

code_block = CodeBlock { "Reference Point"; }
filterByString = Custom[ST.List.FilterByString](VARlist=n01_select_points, VARString=code_block)  # package Synthesize toolkit; Filter a list by a string match
reference_point_to_coordinate = Custom[Reference Point To Coordinate System](VARReferencePoint=filterByString.VARMatch)  # package Synthesize toolkit; Reference Point To Coordinate System
create = List.Create(item0=reference_point_to_coordinate)
k_super_adaptive_paneling = Custom[K-Super Adaptive Paneling](VARFamilyType=n02_adaptive_family, VARFlip=n03_adaptive_flip_parameter, VARReversePlacementDirection=n06_reverse_placement_direction, VARZAlwaysUp=n05_z_always_up, VARCoordinateSystem=create, VARDegreesZAxis=n04_adaptive_point_rotation)  # package Synthesize toolkit; K-Super Adaptive Paneling
debug_python = Custom[Debug Python]()  # package Synthesize toolkit; Debug Python
