# Dynamo graph Conceptual.Adaptive Placement By Voronoi.dyn (Dynamo 2.13.1.3887)
# author: karam@aecedx.com
# packages: Synthesize toolkit 12.5.1

# group: Input
n14_create_selection_filter = BoolSelector(true)  # "14.Create Selection Filter ?"; graph input
n15_adaptive_component_filter = StringInput("Dynamo Voronoi Adaptive Components")  # "15.Adaptive component Filter Name"; graph input
n16_overwrite_existing_filter = BoolSelector(false)  # "16.Overwrite Existing Filter ? (False for Adding Elements)"; graph input
n08_place_connection_family = BoolSelector(false)  # "08.Place Connection Family ?"; graph input
n02_voronoi_offset_from_surface = DoubleInput(0)  # "02.Voronoi Offset From Surface"; graph input
n01_select_faces = SelectFaces()  # "01.Select Faces"; nothing selected; graph input
n03_density_u = DoubleInput(100)  # "03.Density U"; graph input
n04_density_v = DoubleInput(100)  # "04.Density V"; graph input
n05_scale_x = DoubleInput(1)  # "05.Scale X"; graph input
n06_scale_y = DoubleInput(1)  # "06.Scale Y"; graph input
n07_scale_z = DoubleInput(1)  # "07.Scale Z"; graph input
n11_number_of_adaptive_points_for = DoubleInput(3)  # "11.Number of Adaptive Points For Frame Family"; graph input
n09_connection_adaptive_family_1 = FamilyTypes()  # "09.Connection Adaptive Family (1 Point)"; nothing selected; graph input
n13_flip = BoolSelector(false)  # "13.Flip ?"; graph input
n10_place_frame_family = BoolSelector(false)  # "10.Place Frame Family ?"; graph input
n12_frame_adaptive_family = FamilyTypes()  # "12.Frame Adaptive Family"; nothing selected; graph input

join = List.Join()  # unwired: list0, list1
surface_importer = Custom[Surface Importer](VARSurfaces=n01_select_faces)  # package Synthesize toolkit; Surface Importer Node
surfaces = PolySurface.Surfaces(polySurface=surface_importer)
flatten = List.Flatten(list=surfaces)
byOriginNormal = Plane.ByOriginNormal()
area = Surface.Area(surface=flatten)
maximumItem = List.MaximumItem(list=area)
sqrt = Math.Sqrt(number=maximumItem)
byWidthLength = Rectangle.ByWidthLength(plane=byOriginNormal, width=sqrt, length=sqrt)
byPatch = Surface.ByPatch(closedCurve=byWidthLength)
randomList = Math.RandomList(amount=n03_density_u)
code_block = CodeBlock { UMinRange : int = 0; }
code_block_2 = CodeBlock { UMaxRange : int = 1; }
remapRange = Math.RemapRange(numbers=randomList, newMin=code_block, newMax=code_block_2)
randomList_2 = Math.RandomList(amount=n04_density_v)
code_block_3 = CodeBlock { VMinRange : int = 0; }
code_block_4 = CodeBlock { VMaxRange : int = 1; }
remapRange_2 = Math.RemapRange(numbers=randomList_2, newMin=code_block_3, newMax=code_block_4)
byCoordinates = UV.ByCoordinates(u=remapRange, v=remapRange_2)
flatten_2 = List.Flatten(list=byCoordinates)
code_block_5 = CodeBlock { false; }
clean = List.Clean(list=flatten_2, preserveIndices=code_block_5)
scale = Geometry.Scale(geometry=byPatch, xamount=n05_scale_x, yamount=n06_scale_y, zamount=n07_scale_z)
byGeometry = BoundingBox.ByGeometry(geom=scale)
minPoint = BoundingBox.MinPoint(boundingBox=byGeometry)
maxPoint = BoundingBox.MaxPoint(boundingBox=byGeometry)
byStartPointEndPoint = Line.ByStartPointEndPoint(startPoint=minPoint, endPoint=maxPoint)
length = Curve.Length(curve=byStartPointEndPoint)
code_block_6 = CodeBlock { 2; }
div = length / code_block_6
pointAtSegmentLength = Curve.PointAtSegmentLength(curve=byStartPointEndPoint, segmentLength=div)
X = Point.X(point=pointAtSegmentLength)
Y = Point.Y(point=pointAtSegmentLength)
Z = Point.Z(point=pointAtSegmentLength)
byOrigin = CoordinateSystem.ByOrigin(x=X, y=Y, z=Z)
boundingBox = Geometry.BoundingBox(geometry=byPatch)
minPoint_2 = BoundingBox.MinPoint(boundingBox=boundingBox)
maxPoint_2 = BoundingBox.MaxPoint(boundingBox=boundingBox)
byStartPointEndPoint_2 = Line.ByStartPointEndPoint(startPoint=minPoint_2, endPoint=maxPoint_2)
length_2 = Curve.Length(curve=byStartPointEndPoint_2)
code_block_7 = CodeBlock { 2; }
div_2 = length_2 / code_block_7
pointAtSegmentLength_2 = Curve.PointAtSegmentLength(curve=byStartPointEndPoint_2, segmentLength=div_2)
X_2 = Point.X(point=pointAtSegmentLength_2)
Y_2 = Point.Y(point=pointAtSegmentLength_2)
Z_2 = Point.Z(point=pointAtSegmentLength_2)
byOrigin_2 = CoordinateSystem.ByOrigin(x=X_2, y=Y_2, z=Z_2)
transform = Geometry.Transform(geometry=scale, fromCoordinateSystem=byOrigin, contextCoordinateSystem=byOrigin_2)
byParametersOnSurface = Tessellation.Voronoi.ByParametersOnSurface(uvs=clean, face=transform)
flatten_3 = List.Flatten(list=byParametersOnSurface)
pullOntoSurface = Curve.PullOntoSurface(surface=byPatch)  # unwired: curve
map = List.Map(list=flatten_3, f_x=pullOntoSurface)
code_block_8 = CodeBlock { false; }
clean_2 = List.Clean(list=map, preserveIndices=code_block_8)
flatten_4 = List.Flatten(list=clean_2)
sequence = Sequence(amount=n11_number_of_adaptive_points_for, lacing=Longest)
remapRange_3 = Math.RemapRange(numbers=sequence)
pointAtParameter = Curve.PointAtParameter(curve=flatten_4@L1, param=remapRange_3)
UVParameterAtPoint = Surface.UVParameterAtPoint(surface=byPatch, point=pointAtParameter)
U = UV.U(uV=UVParameterAtPoint)
V = UV.V(uV=UVParameterAtPoint)
pointAtParameter_2 = Surface.PointAtParameter(surface=flatten@L1, u=U, v=V)
flatten_5 = List.Flatten(list=flatten)
coordinate_system_smart_flip = Custom[Coordinate System Smart Flip](VARFamilyType=n09_connection_adaptive_family_1, VARFlip=n13_flip)  # package Synthesize toolkit; Coordinate System Smart Flip
coordinate_system_adaptive = Custom[Coordinate System Adaptive Surface Prepare](VARAdaptivePointsOffset=n02_voronoi_offset_from_surface, VARPointsLists=pointAtParameter_2, VARSurfaces=flatten_5, VARFlip=coordinate_system_smart_flip.VARFlipCoordinateSystemBool)  # package Synthesize toolkit; Coordinate System Adaptive Surface Prepare
firstItem = List.FirstItem(list=coordinate_system_adaptive@@L2)
lastItem = List.LastItem(list=coordinate_system_adaptive@@L2)
combine = List.Combine(comb=join, list1=firstItem, list2=lastItem)
flatten_6 = List.Flatten(list=combine)
origin = CoordinateSystem.Origin(coordinateSystem=flatten_6)
al_duplicate_item_indices = Custom[AL.Duplicate Item Indices](VARList=origin)  # package Synthesize toolkit; Searches an input list for duplicate entries and lists their index numbers. Couple with Get From List to delete duplicates from a list.
itemAtIndex = Custom[SP.List.ItemAtIndex+](VARlist=flatten_6, VARindex=al_duplicate_item_indices.VARUniqueIndices)  # package Synthesize toolkit; Identical to the built in node but works with negative indices
create = List.Create(item0=itemAtIndex)
code_block_9 = CodeBlock { 1; }
chop = List.Chop(list=create@L2, lengths=code_block_9)
code_block_10 = CodeBlock { null; }
scopeIf = Custom[CW.ScopeIf+](VARtest=n08_place_connection_family, VARtrue=chop, VARfalse=code_block_10)  # package Synthesize toolkit; A (hopefully) more robust implementation of ScopeIf. Tests a single boolean and returns a value accordingly.
k_adaptive_component_by = Custom[K-Adaptive Component By Coordinate System](VARCoordinateSystem=scopeIf, VARFamilyType=n09_connection_adaptive_family_1, VARFlip=coordinate_system_smart_flip.VARFlipParameterBool)  # package Synthesize toolkit; A Better Adaptive Component Placement Method Using Coordinate System
flatten_7 = List.Flatten(list=flatten)
coordinate_system_smart_flip_2 = Custom[Coordinate System Smart Flip](VARFamilyType=n12_frame_adaptive_family, VARFlip=n13_flip)
coordinate_system_adaptive_2 = Custom[Coordinate System Adaptive Surface Prepare](VARAdaptivePointsOffset=n02_voronoi_offset_from_surface, VARPointsLists=pointAtParameter_2, VARSurfaces=flatten_7, VARFlip=coordinate_system_smart_flip_2.VARFlipCoordinateSystemBool)
scopeIf_2 = Custom[CW.ScopeIf+](VARtest=n10_place_frame_family, VARtrue=coordinate_system_adaptive_2, VARfalse=code_block_10)
k_adaptive_component_by_2 = Custom[K-Adaptive Component By Coordinate System](VARCoordinateSystem=scopeIf_2, VARFamilyType=n12_frame_adaptive_family, VARFlip=coordinate_system_smart_flip_2.VARFlipParameterBool)
create_2 = List.Create(item0=k_adaptive_component_by, item1=k_adaptive_component_by_2)
code_block_11 = CodeBlock { false; }
clean_3 = List.Clean(list=create_2, preserveIndices=code_block_11)
flatten_8 = List.Flatten(list=clean_3)
generate_selection_filter = Custom[Generate Selection Filter](VARCreateSelectionFilter=n14_create_selection_filter, VARFilterNametoCreate=n15_adaptive_component_filter, VAROverwriteExistingFilter=n16_overwrite_existing_filter, VARElements=flatten_8)  # package Synthesize toolkit; Generate Selection FIlter
debug_python = Custom[Debug Python]()  # package Synthesize toolkit; Debug Python
