# Dynamo graph Conceptual.Adaptive Points Sort Using Ref Points By Family and Type.dyn "Conceptual.Adaptive Sort Adaptive Points With Reference Points By Family and Type" (Dynamo 2.13.1.3887)
# author: karam@aecedx.com
# packages: Synthesize toolkit 12.5.1

debug_python_no_message = Custom[Debug Python No Message]()  # package Synthesize toolkit; Debug Python

# group: Input
n01_all_elements_of_family_name = BoolSelector(true)  # "01.All Elements of Family Name (All types) ?"; graph input
n02_family_names_separate_by = StringInput("Family")  # "02.Family Names (Separate By Comma , - or * To Select All Matching)"; graph input
n03_specific_type_name_separate = StringInput("Type")  # "03.Specific Type Name (Separate by Comma , )"; graph input
code_block = CodeBlock { ","; }
n04_elements_in_active_view_only = BoolSelector(false)  # "04.Elements In Active View Only ?"; graph input
n05_select_sorting_reference = DSModelElementsSelection()  # "05.Select Sorting Reference Points"; nothing selected; graph input

family_and_type_selector = Custom[Family and Type Selector](VARAllElementsofFamilyNameAlltypes=n01_all_elements_of_family_name, VARFamilyName=n02_family_names_separate_by, VARSpecificTypeNamesSeparatebySymbol=n03_specific_type_name_separate, VARSeparationSymbol=code_block, VAROnlyInActiveView=n04_elements_in_active_view_only)  # package Synthesize toolkit; Family and Type Selector
sort_adaptive_by_reference = Custom[Sort Adaptive By Reference Points](VARAdaptiveComponents=family_and_type_selector.VARElements, VARReferencePoints=n05_select_sorting_reference)  # package Synthesize toolkit; Sort Adaptive By Points
