# Dynamo graph Conceptual.Adaptive Points Sort Using Ref Points By Selection Filter.dyn "Conceptual.Adaptive Sort Adaptive Points With Reference Points By Selection Filter" (Dynamo 2.13.1.3887)
# author: karam@aecedx.com
# packages: Synthesize toolkit 12.5.1

debug_python_no_message = Custom[Debug Python No Message]()  # package Synthesize toolkit; Debug Python
hot_get_all_filter = Custom[HOT.Get All Filter]()  # package Synthesize toolkit; Get all Filter
toLower = String.ToLower(string=hot_get_all_filter.VARName)
trimWhitespace = String.TrimWhitespace(string=toLower)

# group: Input
n01_selection_filter_to_read_and = StringInput("Selection Filter")  # "01.Selection Filter to Read and Shift"; graph input
n02_select_sorting_reference = DSModelElementsSelection()  # "02.Select Sorting Reference Points"; nothing selected; graph input

toLower_2 = String.ToLower(string=n01_selection_filter_to_read_and)
trimWhitespace_2 = String.TrimWhitespace(string=toLower_2)
eq = trimWhitespace == trimWhitespace_2
filterByBoolMask = List.FilterByBoolMask(list=hot_get_all_filter.VARElement, mask=eq)
elements = Custom[CW.SelectionSet.Elements](VARselectionSet=filterByBoolMask.in)  # package Synthesize toolkit; Retrieves all elements stored in a selection set
sort_adaptive_by_reference = Custom[Sort Adaptive By Reference Points](VARAdaptiveComponents=elements, VARReferencePoints=n02_select_sorting_reference)  # package Synthesize toolkit; Sort Adaptive By Points
