# Dynamo graph Conceptual.Adaptive Renumber Adaptive Points By All Elements of Active View.dyn (Dynamo 2.13.1.3887)
# author: karam@aecedx.com
# packages: Synthesize toolkit 12.5.1

debug_python_no_message = Custom[Debug Python No Message]()  # package Synthesize toolkit; Debug Python
python_all_elements_in_active = Custom[Python All Elements In Active View]()  # package Synthesize toolkit; Python All Elements In Active View

# group: Input
n01_points_group_1_separate_by = StringInput("2,1")  # "01.Points Group 1 (Separate By Comma ,)"; graph input
n02_points_group_2_separate_by = StringInput("4,3")  # "02.Points Group 2 (Separate By Comma ,)"; graph input

renumber_adaptive_components = Custom[Renumber Adaptive Components](VARAdaptiveComponents=python_all_elements_in_active, VARNumbersList1=n01_points_group_1_separate_by, VARNumbersList2=n02_points_group_2_separate_by)  # package Synthesize toolkit; Renumber Adaptive Components
