# Dynamo graph Conceptual.Adaptive Renumber Adaptive Points By Selection Filter.dyn (Dynamo 2.13.1.3887)
# author: karam@aecedx.com
# packages: Synthesize toolkit 12.5.1

debug_python_no_message = Custom[Debug Python No Message]()  # package Synthesize toolkit; Debug Python
hot_get_all_filter = Custom[HOT.Get All Filter]()  # package Synthesize toolkit; Get all Filter
toLower = String.ToLower(string=hot_get_all_filter.VARName)
trimWhitespace = String.TrimWhitespace(string=toLower)

# group: Input
n01_selection_filter_to_read_and = StringInput("Selection Filter")  # "01.Selection Filter to Read and Shift"; graph input
n02_points_group_1_separate_by = StringInput("2,1")  # "02.Points Group 1 (Separate By Comma ,)"; graph input
n03_points_group_2_separate_by = StringInput("4,3")  # "03.Points Group 2 (Separate By Comma ,)"; graph input

toLower_2 = String.ToLower(string=n01_selection_filter_to_read_and)
trimWhitespace_2 = String.TrimWhitespace(string=toLower_2)
eq = trimWhitespace == trimWhitespace_2
filterByBoolMask = List.FilterByBoolMask(list=hot_get_all_filter.VARElement, mask=eq)
elements = Custom[CW.SelectionSet.Elements](VARselectionSet=filterByBoolMask.in)  # package Synthesize toolkit; Retrieves all elements stored in a selection set
renumber_adaptive_components = Custom[Renumber Adaptive Components](VARAdaptiveComponents=elements, VARNumbersList1=n02_points_group_1_separate_by, VARNumbersList2=n03_points_group_2_separate_by)  # package Synthesize toolkit; Renumber Adaptive Components
