# Dynamo graph Conceptual.Adaptive Shift Adaptive Points By Selection Filter.dyn (Dynamo 2.13.1.3887)
# author: karam@aecedx.com
# packages: Synthesize toolkit 12.5.1

hot_get_all_filter = Custom[HOT.Get All Filter]()  # package Synthesize toolkit; Get all Filter
toLower = String.ToLower(string=hot_get_all_filter.VARName)
trimWhitespace = String.TrimWhitespace(string=toLower)

# group: Input
n01_selection_filter_to_read_and = StringInput("Selection Filter")  # "01.Selection Filter to Read and Shift"; graph input
n02_shift_number = DoubleInput(1)  # "02.Shift Number"; graph input
n03_clockwise = BoolSelector(false)  # "03.Clockwise ?"; graph input

toLower_2 = String.ToLower(string=n01_selection_filter_to_read_and)
trimWhitespace_2 = String.TrimWhitespace(string=toLower_2)
eq = trimWhitespace == trimWhitespace_2
filterByBoolMask = List.FilterByBoolMask(list=hot_get_all_filter.VARElement, mask=eq)
elements = Custom[CW.SelectionSet.Elements](VARselectionSet=filterByBoolMask.in)  # package Synthesize toolkit; Retrieves all elements stored in a selection set
shift_adaptive_components = Custom[Shift Adaptive Components](VARAdaptiveComponents=elements, VARShiftNumber=n02_shift_number, VARClockWise=n03_clockwise)  # package Synthesize toolkit; Shift Adaptive Components
debug_python_no_message = Custom[Debug Python No Message]()  # package Synthesize toolkit; Debug Python
