# Dynamo graph Conceptual.Adaptive Shift Adaptive Points By Selection.dyn (Dynamo 2.13.1.3887)
# author: karam@aecedx.com
# packages: Synthesize toolkit 12.5.1

# group: Input
n01_select_adaptive_components = DSModelElementsSelection()  # "01.Select Adaptive Components"; nothing selected; graph input
n02_shift_number = DoubleInput(1)  # "02.Shift Number"; graph input
n03_clockwise = BoolSelector(false)  # "03.Clockwise ?"; graph input

shift_adaptive_components = Custom[Shift Adaptive Components](VARAdaptiveComponents=n01_select_adaptive_components, VARShiftNumber=n02_shift_number, VARClockWise=n03_clockwise)  # package Synthesize toolkit; Shift Adaptive Components
debug_python_no_message = Custom[Debug Python No Message]()  # package Synthesize toolkit; Debug Python
