# Dynamo graph Conceptual.Adaptive Sort Adaptive Points With Reference Points By Selection.dyn (Dynamo 2.13.1.3887)
# author: karam@aecedx.com
# packages: Synthesize toolkit 12.5.1

debug_python_no_message = Custom[Debug Python No Message]()  # package Synthesize toolkit; Debug Python

# group: Input
n01_select_adaptive_components = DSModelElementsSelection()  # "01.Select Adaptive Components"; nothing selected; graph input
n02_select_sorting_reference = DSModelElementsSelection()  # "02.Select Sorting Reference Points"; nothing selected; graph input

sort_adaptive_by_reference = Custom[Sort Adaptive By Reference Points](VARAdaptiveComponents=n01_select_adaptive_components, VARReferencePoints=n02_select_sorting_reference)  # package Synthesize toolkit; Sort Adaptive By Points
