# Dynamo graph Conceptual.Adaptive Transfer Between Documents.dyn (Dynamo 2.13.1.3887)
# author: karam@aecedx.com
# packages: Synthesize toolkit 12.5.1

# group: Input
n01_from_document_number = DoubleInput(0)  # "01.From Document (Number)"; graph input
n02_to_document_number = DoubleInput(1)  # "02.To Document (Number)"; graph input
n03_adaptive_family_name = StringInput("Panel")  # "03.Adaptive Family Name"; graph input
proceed = BoolSelector(false)  # "04.Proceed"; graph input

python_script = Python(IN[0]=n01_from_document_number, IN[1]=n02_to_document_number, IN[2]=n03_adaptive_family_name, IN[3]=proceed)  # IronPython2
# ---------- python_script.python (116 lines) ----------
# Enable Python support and load DesignScript library
# IMPORTANT : ALL DYNAMO DESIGN SCRIPT NODES ARE AS (dg)
import clr
clr.AddReference('ProtoGeometry')
from Autodesk.DesignScript import Geometry as dg

# EXTENSION Enable ToDSType
clr.AddReference('RevitNodes')
import Revit

# Enable Revit API
clr.AddReference('RevitAPI')
from Autodesk.Revit.DB import *

# Enable DocumentManager and TransactionManager
clr.AddReference('RevitServices')
from RevitServices.Persistence import DocumentManager
from RevitServices.Transactions import TransactionManager

clr.ImportExtensions(Revit.GeometryConversion)

class WarnSwallowSimple(IFailuresPreprocessor):
	def PreprocessFailures(self, failuresAccessor):
		failuresAccessor.DeleteAllWarnings()
		return FailureProcessingResult.Continue

# Choose The Current Document
doc = DocumentManager.Instance.CurrentDBDocument
uidoc = DocumentManager.Instance.CurrentUIApplication.ActiveUIDocument
uiapp = DocumentManager.Instance.CurrentUIApplication
app = uiapp.Application

from_doc = int(IN[0])
to_doc = int(IN[1])
family = IN[2]
proceed = IN[3]

alldocs = app.Documents
fucked = []
document_names = []
for eachdoc in alldocs:
	name = eachdoc.Title
	is_family = eachdoc.IsFamilyDocument
	if is_family and name.endswith(".rfa") == False:
		document_names.append(name + ".rfa")
	elif is_family == False and name.endswith(".rvt") == False:
		document_names.append(name + ".rvt")
	else:
		document_names.append(name)
			
if proceed and from_doc != to_doc:
	from_doc = list(alldocs)[from_doc]
	to_doc = list(alldocs)[to_doc]
	
	familyInstances = allfamtypes = [x for x in FilteredElementCollector(from_doc).OfClass(FamilyInstance).ToElements() if family.lower() == x.Symbol.Family.Name.lower() and x.SuperComponent == None]
	
	if len(familyInstances) > 0:
		megaData = []
		for familyInstance in familyInstances:
			data = []
			origins = []
			planes = []
			allParams = familyInstance.GetOrderedParameters()
			typeName = from_doc.GetElement(familyInstance.GetTypeId()).get_Parameter(BuiltInParameter.ALL_MODEL_TYPE_NAME).AsString()
			for param in allParams:
				if param.HasValue and param.IsReadOnly == False:
					paramType = param.Definition.ParameterType.ToString()
					if paramType == "Invalid":
						continue
					paramName = param.Definition.Name
					if paramType == "Text":
						data.append([paramName,param.AsString(),0])
					elif paramType == "YesNo" or paramType == "Integer":
						data.append([paramName,param.AsInteger(),1])
					elif paramType == "Length" or paramType == "Angle":
						data.append([paramName,param.AsDouble(),2])
			adaptPointsRefs = AdaptiveComponentInstanceUtils.GetInstancePlacementPointElementRefIds(familyInstance)
			for adaptPointRef in adaptPointsRefs:
				ptelement = from_doc.GetElement(adaptPointRef)
				coord = ptelement.GetCoordinateSystem()
				origin = coord.Origin
				plane = Plane.CreateByOriginAndBasis(origin,coord.BasisX,coord.BasisY)
				origins.append(origin)
				planes.append(plane)
			megaData.append([typeName,origins,planes,data])
	
		TransactionManager.Instance.ForceCloseTransaction()
		trans1 = Transaction(to_doc, 'Transfer Adaptive Families')
		trans1.Start()
		warnhandle = WarnSwallowSimple()
		foptions = trans1.GetFailureHandlingOptions()
		foptions.SetFailuresPreprocessor(warnhandle)
		trans1.SetFailureHandlingOptions(foptions)
	
		familySymbolsNames = []
		familySymbols = allfamtypes = [x for x in FilteredElementCollector(to_doc).OfClass(FamilySymbol).ToElements() if family.lower() == x.Family.Name.lower()]
		for familySymbol in familySymbols:
			if not familySymbol.IsActive: familySymbol.Activate()
			familySymbolsNames.append(familySymbol.get_Parameter(BuiltInParameter.ALL_MODEL_TYPE_NAME).AsString())
		
		for mega in megaData:
			symbolId = familySymbols[familySymbolsNames.IndexOf(mega[0])]
			adaptFamily = AdaptiveComponentInstanceUtils.CreateAdaptiveComponentInstance(to_doc,symbolId)
			adaptPts = AdaptiveComponentInstanceUtils.GetInstancePlacementPointElementRefIds(adaptFamily)
			count = 0
			for adaptPt in adaptPts:
				ptonPlane = PointOnPlane.NewPointOnPlane(to_doc,SketchPlane.Create(to_doc,mega[2][count]).GetPlaneReference(),mega[1][count],mega[2][count].XVec)
				count += 1
				to_doc.GetElement(adaptPt).SetPointElementReference(ptonPlane)
			for dat in mega[3]:
				try:
					adaptParam = adaptFamily.LookupParameter(dat[0]).Set(dat[1])
				except:
					pass
		trans1.Commit()
OUT = document_names 
# ----------------------------------------
n01_opened_documents_numbers = Watch(python_script)  # "01.Opened Documents (Numbers)"; graph output
debug_python_no_message = Custom[Debug Python No Message]()  # package Synthesize toolkit; Debug Python
