# Dynamo graph Conceptual.Better Create Form By Curve Guide.dyn (Dynamo 2.13.1.3887)
# author: karam@aecedx.com
# packages: Synthesize toolkit 12.5.1

# group: Input
n01_select_profiles = DSModelElementsSelection()  # "01.Select Profiles"; nothing selected; graph input
n02_select_curve_guide = DSModelElementSelection()  # "02.Select Curve Guide"; nothing selected; graph input

code_block = CodeBlock { "DividedPath"; "ComponentRepeater"; }
filterByString = Custom[ST.List.FilterByString](VARlist=n01_select_profiles, VARString=code_block.out1)  # package Synthesize toolkit; Filter a list by a string match
get_family_instances_of_divided = Custom[Get Family Instances of Divided Surface](VARDividedSurfaces=filterByString.VARMatch)  # package Synthesize toolkit; Get Family Instances of Divided Surface
byClassName = Custom[SP.Filter.ByClassName](VARobject=filterByString.VAROther, VARclassName=code_block.out0)  # package Synthesize toolkit; Filters a list of objects by the object's class name. Note that Dynamo elements belong to different classes than their Revit counterparts. Use the Object.Class node to check an object's class.
turnIntoList = Custom[CW.TurnIntoList](VARunknownItem=byClassName.VARin)  # package Synthesize toolkit; Turns an element (or a nested list) into a flat list
python_script = Python(IN[0]=turnIntoList)  # IronPython2
# ---------- python_script.python (55 lines) ----------
# Enable Python support and load DesignScript library
# IMPORTANT : ALL DYNAMO DESIGN SCRIPT NODES ARE AS (dg)
import clr
clr.AddReference('ProtoGeometry')
from Autodesk.DesignScript import Geometry as dg

# EXTENSION Enable ToDSType
clr.AddReference('RevitNodes')
import Revit
clr.ImportExtensions(Revit.Elements)

# Enable Revit Elements
from Revit.Elements import *

# EXTENSION Enable Geometry Conversion Methods
clr.ImportExtensions(Revit.GeometryConversion)

# Enable Revit API
clr.AddReference('RevitAPI')
from Autodesk.Revit.DB import *

# Enable DocumentManager and TransactionManager
clr.AddReference('RevitServices')
from RevitServices.Persistence import DocumentManager
from RevitServices.Transactions import TransactionManager

# Enable ICollection List Translate
clr.AddReference("System")
import System.Collections.Generic
from System.Collections.Generic import List

dataEnteringNode = IN
# Use UnwrapElement(IN[0]) When Translating From Dynamo to Revit
allfaces=UnwrapElement(IN[0])

# Choose The Current Document
doc = DocumentManager.Instance.CurrentDBDocument
uidoc = DocumentManager.Instance.CurrentUIApplication.ActiveUIDocument
uiapp = DocumentManager.Instance.CurrentUIApplication
app = uiapp.Application

# Create Empty List
result = []

filter = ElementClassFilter(CurveElement)

for faces in allfaces:
	ids = faces.GetDependentElements(filter)
	tmp = []
	for id in ids:
		tmp.append(doc.GetElement(id))
	result.append(tmp)

# Assign your output to the OUT variable.
OUT = result
# ----------------------------------------
create = List.Create(item0=get_family_instances_of_divided, item1=python_script, item2=byClassName.VARout)
flatten = List.Flatten(list=create)
location_of_any_element = Custom[Location Of Any Element](VARElements=flatten)  # package Synthesize toolkit; Location Of Any Element
byClassName_2 = Custom[SP.Filter.ByClassName](VARobject=n02_select_curve_guide, VARclassName=code_block.out0)
planes_and_curve_of_divided_path = Custom[Planes and Curve of Divided Path](VARDividedPaths=byClassName_2.VARin)  # package Synthesize toolkit; Planes and Curve of Divided Path
curves = Element.Curves(element=n02_select_curve_guide)
create_2 = List.Create(item0=planes_and_curve_of_divided_path.VARCurves, item1=curves)
code_block_2 = CodeBlock { false; }
clean = List.Clean(list=create_2, preserveIndices=code_block_2)
flatten_2 = List.Flatten(list=clean)
sort_geometry_by_guides = Custom[Sort Geometry By Guides](VARGeometries=location_of_any_element.VARLocations, VARGuides=flatten_2)  # package Synthesize toolkit; Sort Loft Profiles According to Guide
as_list_sortbykey = Custom[AS.[&] List.SortByKey](VARlist=location_of_any_element.VARElements, VARkeys=sort_geometry_by_guides.VARKeys)  # package Synthesize toolkit; Sort a list (or lists) according to the order specified by the key list.
python_script_2 = Python(IN[0]=as_list_sortbykey.VARsortedlist)  # IronPython2
# ---------- python_script_2.python (57 lines) ----------
# Enable Python support and load DesignScript library
# IMPORTANT : ALL DYNAMO DESIGN SCRIPT NODES ARE AS (dg)
import clr
clr.AddReference('ProtoGeometry')
from Autodesk.DesignScript import Geometry as dg

# EXTENSION Enable ToDSType
clr.AddReference('RevitNodes')
import Revit
clr.ImportExtensions(Revit.Elements)

# Enable Revit Elements
from Revit.Elements import *

# EXTENSION Enable Geometry Conversion Methods
clr.ImportExtensions(Revit.GeometryConversion)

# Enable Revit API
clr.AddReference('RevitAPI')
from Autodesk.Revit.DB import *

# Enable DocumentManager and TransactionManager
clr.AddReference('RevitServices')
from RevitServices.Persistence import DocumentManager
from RevitServices.Transactions import TransactionManager

# Enable ICollection List Translate
clr.AddReference("System")
import System.Collections.Generic
from System.Collections.Generic import List

dataEnteringNode = IN
# Use UnwrapElement(IN[0]) When Translating From Dynamo to Revit
profiles = UnwrapElement(IN[0])
# Choose The Current Document
doc = DocumentManager.Instance.CurrentDBDocument
uidoc = DocumentManager.Instance.CurrentUIApplication.ActiveUIDocument
uiapp = DocumentManager.Instance.CurrentUIApplication
app = uiapp.Application

# Create Empty List
result = []

newarray = ReferenceArrayArray()
for p in profiles:
	ref = ReferenceArray()
	ref.Append(Reference(p))
	newarray.Append(ref)
	
# Start a Transaction with Current Document (doc)
TransactionManager.Instance.EnsureInTransaction(doc)
result = doc.FamilyCreate.NewLoftForm(True,newarray)
# End the Transaction with Current Document ()
TransactionManager.Instance.TransactionTaskDone()

# Assign your output to the OUT variable.
OUT = result
# ----------------------------------------
debug_python_no_message = Custom[Debug Python No Message]()  # package Synthesize toolkit; Debug Python
