# Dynamo graph Conceptual.Better Divide Surfaces.dyn (Dynamo 2.13.1.3887)
# author: karam@aecedx.com
# packages: Synthesize toolkit 12.5.1

# group: Input
n01_select_faces = SelectFaces()  # "01.Select Faces"; nothing selected; graph input
n02_fetch_whole_body = BoolSelector(false)  # "02.Fetch Whole Body ?"; graph input
n03_faces_filter_1_vertical_faces = IntegerSlider(4, range=1..4 step 1)  # "03.Faces Filter (1 = Vertical Faces | 2 = Horizontal Up Faces | 3 = Horizontal Down Faces | 4 = All Faces)"; graph input
n04_u_number = DoubleInput(10)  # "04.U Number"; graph input
n05_v_number = DoubleInput(10)  # "05.V Number"; graph input

all_surfaces_or_surface = Custom[All Surfaces or Surface Filtering](VARSurfaces=n01_select_faces, VARFetchWholeBody=n02_fetch_whole_body, VAROrienataion=n03_faces_filter_1_vertical_faces)  # package Synthesize toolkit; All Surfaces or Surface Filtering
python_script = Python(IN[0]=all_surfaces_or_surface.VARRevitFaceReference, IN[1]=n04_u_number, IN[2]=n05_v_number)  # IronPython2
# ---------- python_script.python (66 lines) ----------
# Enable Python support and load DesignScript library
# IMPORTANT : ALL DYNAMO DESIGN SCRIPT NODES ARE AS (dg)
import clr
clr.AddReference('ProtoGeometry')
from Autodesk.DesignScript import Geometry as dg

# EXTENSION Enable ToDSType
clr.AddReference('RevitNodes')
import Revit
clr.ImportExtensions(Revit.Elements)

# Enable Revit Elements
from Revit.Elements import *

# EXTENSION Enable Geometry Conversion Methods
clr.ImportExtensions(Revit.GeometryConversion)

# Enable Revit API
clr.AddReference('RevitAPI')
from Autodesk.Revit.DB import *

# Enable DocumentManager and TransactionManager
clr.AddReference('RevitServices')
from RevitServices.Persistence import DocumentManager
from RevitServices.Transactions import TransactionManager

# Enable ICollection List Translate
clr.AddReference("System")
import System.Collections.Generic
from System.Collections.Generic import List

dataEnteringNode = IN
# Use UnwrapElement(IN[0]) When Translating From Dynamo to Revit
facesref=UnwrapElement(IN[0])
udiv = IN[1]
vdiv = IN[2]
# Choose The Current Document
doc = DocumentManager.Instance.CurrentDBDocument
uidoc = DocumentManager.Instance.CurrentUIApplication.ActiveUIDocument
uiapp = DocumentManager.Instance.CurrentUIApplication
app = uiapp.Application

# Create Empty List
result = []
names = []
# Start a Transaction with Current Document (doc)
TransactionManager.Instance.EnsureInTransaction(doc)
for f in facesref:
	try:
		divsurf = DividedSurface.Create(doc,f)
		try:
			divsurf.get_Parameter(BuiltInParameter.SPACING_NUM_DIVISIONS_U).Set(udiv)
			divsurf.get_Parameter(BuiltInParameter.SPACING_NUM_DIVISIONS_V).Set(vdiv)
		except:
			pass
		result.append(divsurf)
	except:
		divsurf = DividedSurface.GetDividedSurfaceForReference(doc,f)
		result.append(divsurf)

# End the Transaction with Current Document ()
TransactionManager.Instance.TransactionTaskDone()


# Assign your output to the OUT variable.
OUT = result
# ----------------------------------------
debug_python_no_message = Custom[Debug Python No Message]()  # package Synthesize toolkit; Debug Python
