# Dynamo graph Conceptual.DynaForm Complex Nurbs Surface By Points.dyn (Dynamo 2.13.1.3887)
# author: karam@aecedx.com
# packages: Synthesize toolkit 12.5.1

# group: Input
n01_select_points_must_have = DSModelElementsSelection()  # "01.Select Points (Must Have Alphabetical Numbered Sequence)"; nothing selected; graph input
n03_closed = BoolSelector(false)  # "03.Closed ?"; graph input
n02_organic = BoolSelector(true)  # "02.Organic ?"; graph input
n04_get_solid_only_if_organic = BoolSelector(false)  # "04.Get Solid ? (Only if Organic = False and Closed = True)"; graph input
n06_import_to_revit = BoolSelector(false)  # "06.Import to Revit ?"; graph input

dynaform_complex_surface = Custom[DynaForm Complex Surface](VARPoints=n01_select_points_must_have, VARClosed=n03_closed, VAROrganic=n02_organic, VARGetSolidOnlyifOrganic=n04_get_solid_only_if_organic, VARImporttoRevit=n06_import_to_revit)  # package Synthesize toolkit; Creates Nurbs Surface by Points in a Smart way

# group: Splitting -Place "Select Model Elements" node and plug into Geometry -Increate the list and plug when more copies are added from DynaForm
create = List.Create(item0=dynaform_complex_surface.VARGeometry)
flatten = List.Flatten(list=create)
dyna_split = Custom[Dyna Split](VARGeometry=flatten)  # package Synthesize toolkit; Dynamo Split Node; unwired: VARGeometry_2

note = StringInput("-You should open the Script and Run in Automatic mode for more flexibility.")  # "05.Note"; graph input
debug_python = Custom[Debug Python]()  # package Synthesize toolkit; Debug Python
