# Dynamo graph Conceptual.DynaForm Complex T-Surface Bridge By Pick Faces (BETA).dyn (Dynamo 2.13.1.3887)
# author: karam@aecedx.com
# packages: Synthesize toolkit 12.5.1

# group: Input
n02_select_faces = SelectFaces()  # "02.Select Faces"; nothing selected; graph input
n08_u_spans = DoubleInput(10)  # "08.U Spans"; graph input
n09_v_spans = DoubleInput(10)  # "09.V Spans"; graph input
n10_smooth_mode_in_dynamo = BoolSelector(false)  # "10.Smooth Mode (In Dynamo)"; graph input
rotations = DoubleInput(0)  # "05.Rotations"; graph input
spans = DoubleInput(4)  # "06.Spans"; graph input
n07_flip_alignment = BoolSelector(false)  # "07.Flip Alignment"; graph input
n03_select_curves_to_bridge = DSModelElementsSelection()  # "03.Select Curves to Bridge"; nothing selected; graph input
n04_radius_range = DoubleInput(0.5)  # "04.Radius Range"; graph input
n11_import_to_revit = BoolSelector(false)  # "11.Import to Revit ?"; graph input

surface_importer = Custom[Surface Importer](VARSurfaces=n02_select_faces)  # package Synthesize toolkit; Surface Importer Node
surfaces = PolySurface.Surfaces(polySurface=surface_importer)
flatten = List.Flatten(list=surfaces)
toNurbsSurface = Surface.ToNurbsSurface(surface=flatten)
byNurbsSurfaceUniform = TSpline.TSplineSurface.ByNurbsSurfaceUniform(nurbsSurface=toNurbsSurface, uSpans=n08_u_spans, vSpans=n09_v_spans, inSmoothMode=n10_smooth_mode_in_dynamo)
firstItem = List.FirstItem(list=byNurbsSurfaceUniform)
lastItem = List.LastItem(list=byNurbsSurfaceUniform)

# group: Connect For Importing to Revit
dynaform_complex_t_surface = Custom[DynaForm Complex T-Surface Bridge](VARtSplineSurface=firstItem, VARtSplineSurface_2=lastItem, VARframeRotations=rotations, VARspansCounts=spans, VARflipAlignmentFlags=n07_flip_alignment, VARCurvetoFollowandDetectthesurfaces=n03_select_curves_to_bridge, VARRadiusoftheIntersectingCurve=n04_radius_range)  # package Synthesize toolkit; Bridge Between Faces
dynaform_t_spline_import = Custom[DynaForm T-Spline Import](VARtSplineSurface=dynaform_complex_t_surface, VARImporttoRevit=n11_import_to_revit)  # package Synthesize toolkit; Import to Revit

# group: Splitting -Place "Select Model Elements" node and plug into Geometry -Increate the list and plug when more copies are added from DynaForm
create = List.Create(item0=dynaform_t_spline_import.VARGeometry)
flatten_2 = List.Flatten(list=create)
dyna_split = Custom[Dyna Split](VARGeometry=flatten_2)  # package Synthesize toolkit; Dynamo Split Node; unwired: VARGeometry_2

note = StringInput("-You should open the Script and Run in Automatic mode for more flexibility.")  # "01.Note"; graph input
debug_python = Custom[Debug Python]()  # package Synthesize toolkit; Debug Python
