# Dynamo graph Conceptual.DynaForm Complex T-Surface By Points with Bridge (BETA).dyn (Dynamo 2.13.1.3887)
# author: karam@aecedx.com
# packages: Synthesize toolkit 12.5.1

# group: Input
n02_select_points_must_have = DSModelElementsSelection()  # "02.Select Points (Must Have Alphabetical Numbered Sequence)"; nothing selected; graph input
n04_closed = BoolSelector(false)  # "04.Closed ?"; graph input
n03_max_face_valence = DoubleInput(4)  # "03.Max Face Valence"; graph input
n06_snapping_tolerance = DoubleInput(0.001)  # "06.Snapping Tolerance"; graph input
n05_crease_outer_vertices = BoolSelector(true)  # "05.Crease Outer Vertices ?"; graph input
n07_smooth_mode_in_dyanmo = BoolSelector(false)  # "07.Smooth Mode (In Dyanmo)"; graph input

dynaform_complex_t_surface = Custom[DynaForm Complex T-Surface](VARPoints=n02_select_points_must_have, VARClosed=n04_closed)  # package Synthesize toolkit; Creates Nurbs Surface by Points in a Smart way
flatten = List.Flatten(list=dynaform_complex_t_surface)
buildFromLines = TSpline.TSplineSurface.BuildFromLines(lines=flatten, maxFaceValence=n03_max_face_valence, snappingTolerance=n06_snapping_tolerance, creaseOuterVertices=n05_crease_outer_vertices, inSmoothMode=n07_smooth_mode_in_dyanmo)

# group: Input
n13_select_points_must_have = DSModelElementsSelection()  # "13.Select Points (Must Have Alphabetical Numbered Sequence)"; nothing selected; graph input
n16_closed = BoolSelector(false)  # "16.Closed ?"; graph input
n14_max_face_valence = DoubleInput(4)  # "14.Max Face Valence"; graph input
n17_snapping_tolerance = DoubleInput(0.001)  # "17.Snapping Tolerance"; graph input
n15_crease_outer_vertices = BoolSelector(true)  # "15.Crease Outer Vertices ?"; graph input
n18_smooth_mode_in_dyanmo = BoolSelector(false)  # "18.Smooth Mode (In Dyanmo)"; graph input

dynaform_complex_t_surface_2 = Custom[DynaForm Complex T-Surface](VARPoints=n13_select_points_must_have, VARClosed=n16_closed)
flatten_2 = List.Flatten(list=dynaform_complex_t_surface_2)
buildFromLines_2 = TSpline.TSplineSurface.BuildFromLines(lines=flatten_2, maxFaceValence=n14_max_face_valence, snappingTolerance=n17_snapping_tolerance, creaseOuterVertices=n15_crease_outer_vertices, inSmoothMode=n18_smooth_mode_in_dyanmo)

# group: Input
rotations = DoubleInput(0)  # "10.Rotations"; graph input
spans = DoubleInput(4)  # "11.Spans"; graph input
n12_flip_alignment = BoolSelector(false)  # "12.Flip Alignment"; graph input
n08_select_curves_to_bridge = DSModelElementsSelection()  # "08.Select Curves to Bridge"; nothing selected; graph input
n09_radius_range = DoubleInput(0.5)  # "09.Radius Range"; graph input

# group: Input
n19_import_to_revit = BoolSelector(false)  # "19.Import to Revit ?"; graph input

# group: Connect For Importing to Revit
dynaform_complex_t_surface_3 = Custom[DynaForm Complex T-Surface Bridge](VARtSplineSurface=buildFromLines, VARtSplineSurface_2=buildFromLines_2, VARframeRotations=rotations, VARspansCounts=spans, VARflipAlignmentFlags=n12_flip_alignment, VARCurvetoFollowandDetectthesurfaces=n08_select_curves_to_bridge, VARRadiusoftheIntersectingCurve=n09_radius_range)  # package Synthesize toolkit; Bridge Between Faces
dynaform_t_spline_import = Custom[DynaForm T-Spline Import](VARtSplineSurface=dynaform_complex_t_surface_3, VARImporttoRevit=n19_import_to_revit)  # package Synthesize toolkit; Import to Revit

# group: Splitting -Place "Select Model Elements" node and plug into Geometry -Increate the list and plug when more copies are added from DynaForm
create = List.Create(item0=dynaform_t_spline_import.VARGeometry)
flatten_3 = List.Flatten(list=create)
dyna_split = Custom[Dyna Split](VARGeometry=flatten_3)  # package Synthesize toolkit; Dynamo Split Node; unwired: VARGeometry_2

note = StringInput("-You should open the Script and Run in Automatic mode for more flexibility.")  # "01.Note"; graph input
debug_python = Custom[Debug Python]()  # package Synthesize toolkit; Debug Python
