# Dynamo graph Conceptual.DynaForm Complex T-Surface By Points.dyn (Dynamo 2.13.1.3887)
# author: karam@aecedx.com
# packages: Synthesize toolkit 12.5.1

# group: Input
n03_1_smooth_2_ultra_smooth_3 = IntegerSlider(1, range=1..3 step 1)  # "03.1 = Smooth | 2 = Ultra Smooth | 3 = Matched Points"; graph input
n02_select_points_must_have = DSModelElementsSelection()  # "02.Select Points (Must Have Alphabetical Numbered Sequence)"; nothing selected; graph input
n04_closed = BoolSelector(false)  # "04.Closed ?"; graph input
n06_max_face_valence = DoubleInput(4)  # "06.Max Face Valence"; graph input
n07_snapping_tolerance = DoubleInput(0.001)  # "07.Snapping Tolerance"; graph input
n05_crease_outer_vertices = BoolSelector(true)  # "05.Crease Outer Vertices ?"; graph input
n08_smooth_mode_in_dynamo = BoolSelector(false)  # "08.Smooth Mode (In Dynamo)"; graph input
n09_import_to_revit = BoolSelector(false)  # "09.Import to Revit ?"; graph input
note = StringInput("-You can open the Script and Run in Automatic mode for more flexibility.")  # "01.Note"; graph input

dynaform_complex_t_surface = Custom[DynaForm Complex T-Surface](VARPoints=n02_select_points_must_have, VARClosed=n04_closed)  # package Synthesize toolkit; Creates Nurbs Surface by Points in a Smart way
flatten = List.Flatten(list=dynaform_complex_t_surface)

# group: Connect For Importing to Revit
code_block = CodeBlock { 1; }
eq = n03_1_smooth_2_ultra_smooth_3 == code_block
buildFromLines = TSpline.TSplineSurface.BuildFromLines(lines=flatten, maxFaceValence=n06_max_face_valence, snappingTolerance=n07_snapping_tolerance, creaseOuterVertices=n05_crease_outer_vertices, inSmoothMode=n08_smooth_mode_in_dynamo)
code_block_2 = CodeBlock { null; false; }
scopeIf = Custom[CW.ScopeIf+](VARtest=eq, VARtrue=buildFromLines, VARfalse=code_block_2.out0)  # package Synthesize toolkit; A (hopefully) more robust implementation of ScopeIf. Tests a single boolean and returns a value accordingly.
turnIntoList = Custom[CW.TurnIntoList](VARunknownItem=scopeIf)  # package Synthesize toolkit; Turns an element (or a nested list) into a flat list
clean = List.Clean(list=turnIntoList, preserveIndices=code_block_2.out1)
code_block_3 = CodeBlock { 2; 3; }
eq_2 = n03_1_smooth_2_ultra_smooth_3 == code_block_3.out1
code_block_4 = CodeBlock { null; false; }
scopeIf_2 = Custom[CW.ScopeIf+](VARtest=eq_2, VARtrue=buildFromLines, VARfalse=code_block_4.out0)
turnIntoList_2 = Custom[CW.TurnIntoList](VARunknownItem=scopeIf_2)
clean_2 = List.Clean(list=turnIntoList_2, preserveIndices=code_block_4.out1)
flatten_2 = List.Flatten(list=clean_2)
interpolate = TSpline.TSplineSurface.Interpolate(tSplineSurface=flatten_2)
eq_3 = n03_1_smooth_2_ultra_smooth_3 == code_block_3.out0
scopeIf_3 = Custom[CW.ScopeIf+](VARtest=eq_3, VARtrue=buildFromLines, VARfalse=code_block_4.out0)
turnIntoList_3 = Custom[CW.TurnIntoList](VARunknownItem=scopeIf_3)
clean_3 = List.Clean(list=turnIntoList_3, preserveIndices=code_block_4.out1)
flatten_3 = List.Flatten(list=clean_3)
code_block_5 = CodeBlock { true; }
interpolate_2 = TSpline.TSplineSurface.Interpolate(tSplineSurface=flatten_3, reverse=code_block_5)
create = List.Create(item0=clean, item1=interpolate, item2=interpolate_2)
code_block_6 = CodeBlock { false; }
clean_4 = List.Clean(list=create, preserveIndices=code_block_6)
flatten_4 = List.Flatten(list=clean_4)
dynaform_t_spline_import = Custom[DynaForm T-Spline Import](VARtSplineSurface=flatten_4, VARImporttoRevit=n09_import_to_revit)  # package Synthesize toolkit; Import to Revit

# group: Splitting -Place "Select Model Elements" node and plug into Geometry -Increate the list and plug when more copies are added from DynaForm
create_2 = List.Create(item0=dynaform_t_spline_import.VARGeometry)
flatten_5 = List.Flatten(list=create_2)
dyna_split = Custom[Dyna Split](VARGeometry=flatten_5)  # package Synthesize toolkit; Dynamo Split Node; unwired: VARGeometry_2

debug_python = Custom[Debug Python]()  # package Synthesize toolkit; Debug Python
