# Dynamo graph Conceptual.DynaForm Simple Nurbs Surface.dyn (Dynamo 2.13.1.3887)
# author: karam@aecedx.com
# packages: Synthesize toolkit 12.5.1

# group: Input
n01_select_points_better_be = DSModelElementsSelection()  # "01.Select Points (Better Be Numbered)"; nothing selected; graph input
n03_import_to_revit = BoolSelector(true)  # "03.Import to Revit ?"; graph input

dynaform_simple_surface = Custom[DynaForm Simple Surface](VARPoints=n01_select_points_better_be)  # package Synthesize toolkit; Dyna Form Simple Surface
debug_python = Custom[Debug Python]()  # package Synthesize toolkit; Debug Python
