# Dynamo graph Conceptual.DynaForm Solid Nurbs Form.dyn (Dynamo 2.13.1.3887)
# author: karam@aecedx.com
# packages: Synthesize toolkit 12.5.1

# group: Input
n02_direct_connect_through_points = BoolSelector(true)  # "02.Direct Connect Through Points ?"; graph input
n03_smoothness_works_if_direct = DoubleSlider(3, range=1..3 step 1)  # "03.Smoothness (Works if Direct Connect = False)"; graph input
n01_select_points_must_have = DSModelElementsSelection()  # "01.Select Points (Must Have Alphabetical Numbered Sequence)"; nothing selected; graph input
n05_import_to_revit = BoolSelector(false)  # "05.Import to Revit ?"; graph input

dynaform_solid_form_with = Custom[DynaForm Solid Form with Importing](VARDirectConnect=n02_direct_connect_through_points, VARdegree=n03_smoothness_works_if_direct, VARPoints=n01_select_points_must_have, VARImporttoRevit=n05_import_to_revit)  # package Synthesize toolkit; Closed Form with Dynamo and importing into Revit directly

# group: Splitting (Optional) -Place "Select Model Elements" node and plug into Geometry -Increate the list and plug when more copies are added from DynaForm
create = List.Create(item0=dynaform_solid_form_with.VARGeometry)
flatten = List.Flatten(list=create)
dyna_split = Custom[Dyna Split](VARGeometry=flatten)  # package Synthesize toolkit; Dynamo Split Node; unwired: VARGeometry_2

note = StringInput("-You should open the Script and Run in Automatic mode for more flexibility.")  # "04.Note"; graph input
debug_python = Custom[Debug Python]()  # package Synthesize toolkit; Debug Python
