# Dynamo graph Conceptual.DynaPoint Generate By CAD Import.dyn (Dynamo 2.13.1.3887)
# author: karam@aecedx.com
# packages: Synthesize toolkit 12.5.1

# group: Input
n01_select_cad_import = DSModelElementSelection()  # "01.Select CAD Import"; nothing selected; graph input
n02_pruning_tollerance_in = DoubleInput(4)  # "02.Pruning Tollerance (In Millimeters)"; graph input

millimetersInput = Custom[MillimetersInput](VARInput=n02_pruning_tollerance_in)  # package Synthesize toolkit; MetersInput
python_script = Python(IN[0]=n01_select_cad_import, IN[1]=millimetersInput)  # IronPython2
# ---------- python_script.python (74 lines) ----------
# Created by Karam Baki: karam@aecedx.com

import clr
clr.AddReference('ProtoGeometry')
from Autodesk.DesignScript import Geometry as dg
clr.AddReference('RevitNodes')
import Revit
clr.ImportExtensions(Revit.GeometryConversion)
clr.AddReference('RevitAPI')
from Autodesk.Revit.DB import *
clr.AddReference('RevitServices')
from RevitServices.Persistence import DocumentManager
from RevitServices.Transactions import TransactionManager
clr.AddReference("RevitAPIUI")
from Autodesk.Revit.UI import TaskDialog

class KaramSwallowSimple(IFailuresPreprocessor):
	def PreprocessFailures(self, failuresAccessor):
		failuresAccessor.DeleteAllWarnings()
		return FailureProcessingResult.Continue

cad = UnwrapElement(IN[0])
tollerance = IN[1]

doc = DocumentManager.Instance.CurrentDBDocument

if int(DocumentManager.Instance.CurrentUIApplication.Application.VersionNumber) == 2022:
	tollerance = UnitUtils.ConvertToInternalUnits(tollerance,doc.GetUnits().GetFormatOptions(SpecTypeId.Length).GetUnitTypeId())

good_to_go = True
msg = "ERROR: Please open a Mass family"
if doc.IsFamilyDocument:
	if doc.OwnerFamily.FamilyCategory.Name != "Mass":
		good_to_go = False
else:
	good_to_go = False

if cad.ToString() != "Autodesk.Revit.DB.ImportInstance":
	good_to_go = False
	msg = "ERROR: Please choose CAD Import Instance"
	
if good_to_go:
	pts = []
	opt = Options()
	geoms = list(cad.get_Geometry(opt))
	for allgeom in geoms:
		allgeom = allgeom.GetInstanceGeometry()
		for geom in allgeom:
			if geom.ToString() == "Autodesk.Revit.DB.Line":
				pts.append(geom.GetEndPoint(0).ToPoint())
				pts.append(geom.GetEndPoint(1).ToPoint())
			elif geom.ToString() == "Autodesk.Revit.DB.PolyLine":
				coords = geom.GetCoordinates()
				for coord in coords:
					pts.append(coord.ToPoint())
	pts = dg.Point.PruneDuplicates(pts,tollerance)
	
	result = []
	TransactionManager.Instance.ForceCloseTransaction()
	trans = Transaction(doc, 'Doing Points Magic')
	trans.Start()
	warnhandle = KaramSwallowSimple()
	foptions = trans.GetFailureHandlingOptions()
	foptions.SetFailuresPreprocessor(warnhandle)
	trans.SetFailureHandlingOptions(foptions)
	for pt in pts:
		refpt = doc.FamilyCreate.NewReferencePoint(pt.ToXyz())
		refpt.Pinned = True
		result.append(refpt)
	trans.Commit()
	TaskDialog.Show("AECedx - Karam", "Success! We Found " + str(len(result)) + " Points" )
	OUT = result
else:
	OUT = TaskDialog.Show("AECedx - Karam", msg)
# ----------------------------------------
debug_python_no_message = Custom[Debug Python No Message]()  # package Synthesize toolkit; Debug Python
