# Dynamo graph Conceptual.DynaPoint Generate By Divided Paths.dyn (Dynamo 2.13.1.3887)
# author: karam@aecedx.com
# packages: Synthesize toolkit 12.5.1

# group: Input
n02_name_points = BoolSelector(true)  # "02.Name Points ?"; graph input
n03_numbering_sequence_false = BoolSelector(false)  # "03.Numbering Sequence = False | Alphabatical Naming = True"; graph input
n04_automatic_points_number = BoolSelector(true)  # "04.Automatic Points Number Detection ? (False for Custom)"; graph input
n05_custom_point_name_numbering = DoubleInput(1)  # "05.Custom Point Name Numbering Sequence Start"; graph input
n01_select_divided_path_s = DSModelElementsSelection()  # "01.Select Divided Path(s)"; nothing selected; graph input

code_block = CodeBlock { true; false; }
scopeIf = Custom[CW.ScopeIf+](VARtest=n02_name_points, VARtrue=n03_numbering_sequence_false, VARfalse=code_block.out1)  # package Synthesize toolkit; A (hopefully) more robust implementation of ScopeIf. Tests a single boolean and returns a value accordingly.
code_block_2 = CodeBlock { "[0-9]+"; }
element_types = ElementTypes("ReferencePoint")
all_elements_of_type = ElementsOfType(element_type=element_types)
code_block_3 = CodeBlock { "Name"; }
getParameterValueByName = Element.GetParameterValueByName(element=all_elements_of_type, parameterName=code_block_3)
code_block_4 = CodeBlock { ""; }
eq = getParameterValueByName == code_block_4
filterByBoolMask = List.FilterByBoolMask(list=getParameterValueByName, mask=eq)
findRegularExpression = Custom[CW.String.FindRegularExpression](VARRegEx=code_block_2, VARstr=filterByBoolMask.out)  # package Synthesize toolkit; Returns all occurences of a regular expression within a string (or list of strings). The syntax for regular expressions is explained at http://ironpython-test.readthedocs.org/en/latest/howto/regex.html
flatten = List.Flatten(list=findRegularExpression)
toNumber = String.ToNumber(string=flatten)
uniqueItems = List.UniqueItems(list=toNumber)
sort = List.Sort(list=uniqueItems)
list_lastitem_fixer = Custom[List.LastItem Fixer](VARlist=sort)  # package Synthesize toolkit; List.LastItem Fixer
code_block_5 = CodeBlock { 1; }
add = list_lastitem_fixer + code_block_5
isNull = Object.IsNull(object=add)
code_block_6 = CodeBlock { 1; }
scopeIf_2 = Custom[CW.ScopeIf+](VARtest=isNull, VARtrue=code_block_6, VARfalse=add)
scopeIf_3 = Custom[CW.ScopeIf+](VARtest=n04_automatic_points_number, VARtrue=scopeIf_2, VARfalse=n05_custom_point_name_numbering)
code_block_7 = CodeBlock { "DividedPath"; }
byClassName = Custom[SP.Filter.ByClassName](VARobject=n01_select_divided_path_s, VARclassName=code_block_7)  # package Synthesize toolkit; Filters a list of objects by the object's class name. Note that Dynamo elements belong to different classes than their Revit counterparts. Use the Object.Class node to check an object's class.
points = DividedPath.Points(dividedPath=byClassName.VARin)
byPoint = ReferencePoint.ByPoint(pt=points)
generate_sequenced_points = Custom[Generate Sequenced Points](VARNumberSequenceStart=scopeIf_3, VARReferencePoints=byPoint, VARNamePoints=scopeIf)  # package Synthesize toolkit; Generate Sequenced Points
scopeIf_4 = Custom[CW.ScopeIf+](VARtest=n02_name_points, VARtrue=n03_numbering_sequence_false, VARfalse=code_block.out0)
code_block_8 = CodeBlock { null; }
scopeIf_5 = Custom[CW.ScopeIf+](VARtest=scopeIf_4, VARtrue=code_block_8, VARfalse=generate_sequenced_points.VARReferencePoints)
code_block_9 = CodeBlock { false; }
clean = List.Clean(list=scopeIf_5, preserveIndices=code_block_9)
code_block_10 = CodeBlock { "Reference Point"; }
filterByString = Custom[ST.List.FilterByString](VARlist=clean, VARString=code_block_10)  # package Synthesize toolkit; Filter a list by a string match
count = List.Count(list=filterByString.VARMatch)
code_block_11 = CodeBlock { 1; }
sequence = Sequence(start=scopeIf_3, amount=count, step=code_block_11, lacing=Longest)
string_from_object = FromObject(obj=sequence)
trimWhitespace = String.TrimWhitespace(string=string_from_object)
code_block_12 = CodeBlock { "Name"; }
code_block_13 = CodeBlock { 0.0001; }
sequence_2 = Sequence(start=code_block_13, amount=count, step=code_block_13, lacing=Longest)
string_from_object_2 = FromObject(obj=sequence_2)
setParameterByName = Element.SetParameterByName(element=filterByString.VARMatch, parameterName=code_block_12, value=string_from_object_2)
passthrough = Custom[CW.Passthrough](VARpassThrough=trimWhitespace, VARwaitFor=setParameterByName)  # package Synthesize toolkit; Forces a sequential order of execution. The node wired into the output of the Passthrough node will be executed *after* the node wired into the waitFor input (e.g. important for some Revit operations). The value of the passThrough input will be passed on to the node wired into the output port of the Passthrough node.
list_lastitem_fixer_2 = Custom[List.LastItem Fixer](VARlist=passthrough)
scopeIf_6 = Custom[CW.ScopeIf+](VARtest=scopeIf, VARtrue=generate_sequenced_points.VARLastPointName, VARfalse=list_lastitem_fixer_2)
code_block_14 = CodeBlock { null; 0; }
eq_2 = scopeIf_6 == code_block_14.out0
code_block_15 = CodeBlock { "Inactive"; }
scopeIf_7 = Custom[CW.ScopeIf+](VARtest=eq_2, VARtrue=code_block_15, VARfalse=scopeIf_6)
passthrough_2 = Custom[CW.Passthrough](VARpassThrough=filterByString.VARMatch, VARwaitFor=setParameterByName)
passthrough_3 = Custom[CW.Passthrough](VARpassThrough=code_block_12, VARwaitFor=setParameterByName)
setParameterByName_2 = Element.SetParameterByName(element=passthrough_2, parameterName=passthrough_3, value=passthrough)
count_2 = List.Count(list=setParameterByName_2)
scopeIf_8 = Custom[CW.ScopeIf+](VARtest=scopeIf_4, VARtrue=generate_sequenced_points.VARNumberofPoints, VARfalse=count_2)
eq_3 = scopeIf_8 == code_block_14.out1
scopeIf_9 = Custom[CW.ScopeIf+](VARtest=eq_3, VARtrue=code_block_15, VARfalse=scopeIf_8)

# group: Report
n01_last_point_name = Watch(scopeIf_7)  # "01.Last Point Name"; graph output
n02_number_of_points_re_named = Watch(scopeIf_9)  # "02.Number of points Re-named"; graph output

debug_python = Custom[Debug Python]()  # package Synthesize toolkit; Debug Python
