# Dynamo graph Conceptual.DynaPoint Generate From Curves.dyn (Dynamo 2.13.1.3887)
# author: karam@aecedx.com
# packages: Synthesize toolkit 12.5.1

# group: Input
n01_select_curves = DSModelElementsSelection()  # "01.Select Curves"; nothing selected; graph input
n02_spacing_method_by_number = BoolSelector(false)  # "02.Spacing Method : By Number = False | By Distance = True"; graph input
n03_number_distance = DoubleInput(50)  # "03.Number/Distance"; graph input
n04_connect_with_spline_by_points = BoolSelector(false)  # "04.Connect With Spline By Points ?"; graph input
n05_is_reference = BoolSelector(false)  # "05.Is Reference ?"; graph input

curve = CurveElement.Curve()  # unwired: curveElement
map = List.Map(list=n01_select_curves, f_x=curve)
isNull = Object.IsNull(object=map)
filterByBoolMask = List.FilterByBoolMask(list=map, mask=isNull)
code_block = CodeBlock { false; }
clean = List.Clean(list=filterByBoolMask.out, preserveIndices=code_block)
flatten = List.Flatten(list=clean)
as_polycurve_bycurves = Custom[AS.[&] PolyCurve.ByCurves](VARcurves=flatten)  # package Synthesize toolkit; Create polycurves from an unordered list of curves.
length = Curve.Length(curve=as_polycurve_bycurves.VARpolyCurve)
div = length / n03_number_distance
round = Math.Round(number=div)
count = List.Count(list=round)
cycle = List.Cycle(list=n03_number_distance, amount=count)
scopeIf = Custom[CW.ScopeIf+](VARtest=n02_spacing_method_by_number, VARtrue=round, VARfalse=cycle)  # package Synthesize toolkit; A (hopefully) more robust implementation of ScopeIf. Tests a single boolean and returns a value accordingly.
sequence = Sequence(amount=scopeIf)
remapRange = Math.RemapRange(numbers=sequence)
python_script = Python(IN[0]=remapRange)  # IronPython2
# ---------- python_script.python (18 lines) ----------
import clr
clr.AddReference('ProtoGeometry')
from Autodesk.DesignScript.Geometry import *
#The inputs to this node will be stored as a list in the IN variables.
dataEnteringNode = IN

list = UnwrapElement(IN[0])

result = []

for l in list:
	if len(l) < 2:
		result.append([0,1])
	else:
		result.append(l)

#Assign your output to the OUT variable.
OUT = result
# ----------------------------------------
pointAtParameter = Curve.PointAtParameter(curve=as_polycurve_bycurves.VARpolyCurve, param=python_script, lacing=Longest)
pruneDuplicates = Point.PruneDuplicates(points=pointAtParameter@L2)
byPoint = ReferencePoint.ByPoint(pt=pruneDuplicates)
flatten_2 = List.Flatten(list=byPoint)
code_block_2 = CodeBlock { "Name"; }
code_block_3 = CodeBlock { "[0-9]+"; }
element_types = ElementTypes("ReferencePoint")
all_elements_of_type = ElementsOfType(element_type=element_types)
code_block_4 = CodeBlock { "Name"; }
getParameterValueByName = Element.GetParameterValueByName(element=all_elements_of_type, parameterName=code_block_4)
code_block_5 = CodeBlock { ""; }
eq = getParameterValueByName == code_block_5
filterByBoolMask_2 = List.FilterByBoolMask(list=getParameterValueByName, mask=eq)
findRegularExpression = Custom[CW.String.FindRegularExpression](VARRegEx=code_block_3, VARstr=filterByBoolMask_2.out)  # package Synthesize toolkit; Returns all occurences of a regular expression within a string (or list of strings). The syntax for regular expressions is explained at http://ironpython-test.readthedocs.org/en/latest/howto/regex.html
flatten_3 = List.Flatten(list=findRegularExpression)
toNumber = String.ToNumber(string=flatten_3)
uniqueItems = List.UniqueItems(list=toNumber)
sort = List.Sort(list=uniqueItems)
list_lastitem_fixer = Custom[List.LastItem Fixer](VARlist=sort)  # package Synthesize toolkit; List.LastItem Fixer
code_block_6 = CodeBlock { 1; }
add = list_lastitem_fixer + code_block_6
isNull_2 = Object.IsNull(object=add)
code_block_7 = CodeBlock { 1; }
scopeIf_2 = Custom[CW.ScopeIf+](VARtest=isNull_2, VARtrue=code_block_7, VARfalse=add)
count_2 = List.Count(list=flatten_2)
sequence_2 = Sequence(start=scopeIf_2, amount=count_2, lacing=Longest)
string_from_object = FromObject(obj=sequence_2)
setParameterByName = Element.SetParameterByName(element=flatten_2, parameterName=code_block_2, value=string_from_object)
debug_python = Custom[Debug Python]()  # package Synthesize toolkit; Debug Python
empty = List.Empty()
scopeIf_3 = Custom[CW.ScopeIf+](VARtest=n04_connect_with_spline_by_points, VARtrue=byPoint, VARfalse=empty)
end = Revit.Transaction.Transaction.End(input=scopeIf_3)
curvebypoints_byreferencepoints = Custom[CurveByPoints.ByReferencePoints Fixer](VARpoints=end, VARisReferenceLine=n05_is_reference)  # package Synthesize toolkit; CurveByPoints.ByReferencePoints Fixer
