# Dynamo graph Conceptual.DynaPoint Host On Curves.dyn (Dynamo 2.13.1.3887)
# author: karam@aecedx.com
# packages: Synthesize toolkit 12.5.1

# group: Input
n01_select_curves = DSModelElementsSelection()  # "01.Select Curves"; nothing selected; graph input
n02_spacing_method_by_number = BoolSelector(false)  # "02.Spacing Method : By Number = False | By Distance = True"; graph input
n03_number_distance = DoubleInput(50)  # "03.Number/Distance"; graph input
n04_connect_with_spline_by_points = BoolSelector(false)  # "04.Connect With Spline By Points ?"; graph input
n05_is_reference = BoolSelector(false)  # "05.Is Reference ?"; graph input

curve = CurveElement.Curve()  # unwired: curveElement
map = List.Map(list=n01_select_curves, f_x=curve)
isNull = Object.IsNull(object=map)
filterByBoolMask = List.FilterByBoolMask(list=map, mask=isNull)
code_block = CodeBlock { false; }
clean = List.Clean(list=filterByBoolMask.out, preserveIndices=code_block)
flatten = List.Flatten(list=clean)
as_polycurve_bycurves = Custom[AS.[&] PolyCurve.ByCurves](VARcurves=flatten)  # package Synthesize toolkit; Create polycurves from an unordered list of curves.
curves = PolyCurve.Curves(polyCurve=as_polycurve_bycurves.VARpolyCurve)
flatten_2 = List.Flatten(list=curves)
filterByBoolMask_2 = List.FilterByBoolMask(list=n01_select_curves, mask=isNull)
clean_2 = List.Clean(list=filterByBoolMask_2.out, preserveIndices=code_block)
flatten_3 = List.Flatten(list=clean_2)
python_script = Python(IN[0]=flatten_2, IN[1]=filterByBoolMask.out, IN[2]=flatten_3)  # IronPython2
# ---------- python_script.python (65 lines) ----------
# Enable Python support and load DesignScript library
# IMPORTANT : ALL DYNAMO DESIGN SCRIPT NODES ARE AS (dg)
import clr
clr.AddReference('ProtoGeometry')
from Autodesk.DesignScript import Geometry as dg

# EXTENSION Enable ToDSType
clr.AddReference('RevitNodes')
import Revit
clr.ImportExtensions(Revit.Elements)

# Enable Revit Elements
from Revit.Elements import *

# EXTENSION Enable Geometry Conversion Methods
clr.ImportExtensions(Revit.GeometryConversion)

# Enable Revit API
clr.AddReference('RevitAPI')
from Autodesk.Revit.DB import *

# Enable DocumentManager and TransactionManager
clr.AddReference('RevitServices')
from RevitServices.Persistence import DocumentManager
from RevitServices.Transactions import TransactionManager

# Enable ICollection List Translate
clr.AddReference("System")
import System.Collections.Generic
from System.Collections.Generic import List

dataEnteringNode = IN
# Use UnwrapElement(IN[0]) When Translating From Dynamo to Revit
goodcurves=UnwrapElement(IN[0])
badcurves=UnwrapElement(IN[1])
elements=UnwrapElement(IN[2])

# Choose The Current Document
doc = DocumentManager.Instance.CurrentDBDocument
uidoc = DocumentManager.Instance.CurrentUIApplication.ActiveUIDocument
uiapp = DocumentManager.Instance.CurrentUIApplication
app = uiapp.Application

counter = 0
goodpoints = []
badpoints = []
for g in goodcurves:
	goodpoints.append(dg.Curve.PointAtParameter(g,0.5))
	badpoints.append(dg.Curve.PointAtParameter(badcurves[counter],0.5))
	counter += 1

organizedcurves = []
organizedelems = []

for g in goodpoints:
	innercounter = 0
	for g2 in badpoints:
		if dg.Geometry.DoesIntersect(g,g2):
			organizedelems.append(elements[innercounter])
			organizedcurves.append(badcurves[innercounter])
			break
		innercounter += 1
	
# Assign your output to the OUT variable.
OUT = organizedcurves,organizedelems
# ----------------------------------------
code_block_2 = CodeBlock(a=python_script) { a[0]; a[1]; }
length = Curve.Length(curve=as_polycurve_bycurves.VARpolyCurve)
div = length / n03_number_distance
round = Math.Round(number=div)
count = List.Count(list=round)
cycle = List.Cycle(list=n03_number_distance, amount=count)
scopeIf = Custom[CW.ScopeIf+](VARtest=n02_spacing_method_by_number, VARtrue=round, VARfalse=cycle)  # package Synthesize toolkit; A (hopefully) more robust implementation of ScopeIf. Tests a single boolean and returns a value accordingly.
sequence = Sequence(amount=scopeIf)
remapRange = Math.RemapRange(numbers=sequence)
python_script_2 = Python(IN[0]=remapRange)  # IronPython2
# ---------- python_script_2.python (18 lines) ----------
import clr
clr.AddReference('ProtoGeometry')
from Autodesk.DesignScript.Geometry import *
#The inputs to this node will be stored as a list in the IN variables.
dataEnteringNode = IN

list = UnwrapElement(IN[0])

result = []

for l in list:
	if len(l) < 2:
		result.append([0,1])
	else:
		result.append(l)

#Assign your output to the OUT variable.
OUT = result
# ----------------------------------------
pointAtParameter = Curve.PointAtParameter(curve=as_polycurve_bycurves.VARpolyCurve, param=python_script_2, lacing=Longest)
pruneDuplicates = Point.PruneDuplicates(points=pointAtParameter@L2)
flatten_4 = List.Flatten(list=pruneDuplicates)
python_script_3 = Python(IN[0]=code_block_2.out0, IN[1]=flatten_4)  # IronPython2
# ---------- python_script_3.python (104 lines) ----------
# Enable Python support and load DesignScript library
# IMPORTANT : ALL DYNAMO DESIGN SCRIPT NODES ARE AS (dg)
import clr
clr.AddReference('ProtoGeometry')
from Autodesk.DesignScript import Geometry as dg

# EXTENSION Enable ToDSType
clr.AddReference('RevitNodes')
import Revit
clr.ImportExtensions(Revit.Elements)

# Enable Revit Elements
from Revit.Elements import *

# EXTENSION Enable Geometry Conversion Methods
clr.ImportExtensions(Revit.GeometryConversion)

# Enable Revit API
clr.AddReference('RevitAPI')
from Autodesk.Revit.DB import *

# Enable DocumentManager and TransactionManager
clr.AddReference('RevitServices')
from RevitServices.Persistence import DocumentManager
from RevitServices.Transactions import TransactionManager

# Enable ICollection List Translate
clr.AddReference("System")
import System.Collections.Generic
from System.Collections.Generic import List

dataEnteringNode = IN
# Use UnwrapElement(IN[0]) When Translating From Dynamo to Revit
curves=UnwrapElement(IN[0])
points=UnwrapElement(IN[1])

# Choose The Current Document
doc = DocumentManager.Instance.CurrentDBDocument
uidoc = DocumentManager.Instance.CurrentUIApplication.ActiveUIDocument
uiapp = DocumentManager.Instance.CurrentUIApplication
app = uiapp.Application

def normalize(length,nostartend = False,twominonly = False):
	if length != None:
		if length <= 3 and twominonly == False:
			length = 4
		elif length <= 3 and twominonly == True:
			if length < 2:
				length = 2
		if nostartend:
			length += 2
		a = range(0,int(length))
		points = []
		amin, amax = min(a), max(a)
		item = []
		for val in a:
			item.append(float(val-amin) / float(amax-amin))
	else:
		item = [None]
	if nostartend == True:
		item.pop(0)
		item.pop(-1)
	return item

def fixcurve(crv,div):
	nums = normalize(div)
	pts = []
	for n in nums:
		pts.append(dg.Curve.PointAtParameter(crv,n))
	pts = dg.Point.PruneDuplicates(pts,0.1)
	curve = dg.NurbsCurve.ByControlPoints(pts)
	return curve

factor = 0.01

excluded = []
grouped = []
for c in curves:
	counter = 0
	tmp = []
	for p in points:
		try:
			if dg.Geometry.DoesIntersect(c,p) and counter not in excluded:
				tmp.append(dg.Curve.ParameterAtPoint(c,p))
				excluded.append(counter)
		except:
			try:
				c1 = dg.PolyCurve.ByJoinedCurves(dg.Curve.ApproximateWithArcAndLineSegments(c))
				if dg.Geometry.DoesIntersect(c1,p) and counter not in excluded:
					tmp.append(dg.Curve.ParameterAtPoint(c,p))
					excluded.append(counter)
			except:
				try:
					c2 = fixcurve(c,c.Length / factor)
					if dg.Geometry.DistanceTo(c2,p) < factor and counter not in excluded:
						tmp.append(dg.Curve.ParameterAtPoint(c,p))
						excluded.append(counter)
				except:
					pass
		counter += 1
	grouped.append(tmp)
	
# Assign your output to the OUT variable.
OUT = grouped
# ----------------------------------------
byParameterOnCurveReference = ReferencePoint.ByParameterOnCurveReference(elementCurveReference=code_block_2.out1, parameter=python_script_3)
flatten_5 = List.Flatten(list=byParameterOnCurveReference)
code_block_3 = CodeBlock { "Name"; }
code_block_4 = CodeBlock { "[0-9]+"; }
element_types = ElementTypes("ReferencePoint")
all_elements_of_type = ElementsOfType(element_type=element_types)
code_block_5 = CodeBlock { "Name"; }
getParameterValueByName = Element.GetParameterValueByName(element=all_elements_of_type, parameterName=code_block_5)
code_block_6 = CodeBlock { ""; }
eq = getParameterValueByName == code_block_6
filterByBoolMask_3 = List.FilterByBoolMask(list=getParameterValueByName, mask=eq)
findRegularExpression = Custom[CW.String.FindRegularExpression](VARRegEx=code_block_4, VARstr=filterByBoolMask_3.out)  # package Synthesize toolkit; Returns all occurences of a regular expression within a string (or list of strings). The syntax for regular expressions is explained at http://ironpython-test.readthedocs.org/en/latest/howto/regex.html
flatten_6 = List.Flatten(list=findRegularExpression)
toNumber = String.ToNumber(string=flatten_6)
uniqueItems = List.UniqueItems(list=toNumber)
sort = List.Sort(list=uniqueItems)
list_lastitem_fixer = Custom[List.LastItem Fixer](VARlist=sort)  # package Synthesize toolkit; List.LastItem Fixer
code_block_7 = CodeBlock { 1; }
add = list_lastitem_fixer + code_block_7
isNull_2 = Object.IsNull(object=add)
code_block_8 = CodeBlock { 1; }
scopeIf_2 = Custom[CW.ScopeIf+](VARtest=isNull_2, VARtrue=code_block_8, VARfalse=add)
count_2 = List.Count(list=flatten_5)
sequence_2 = Sequence(start=scopeIf_2, amount=count_2, lacing=Longest)
string_from_object = FromObject(obj=sequence_2)
setParameterByName = Element.SetParameterByName(element=flatten_5, parameterName=code_block_3, value=string_from_object)
debug_python = Custom[Debug Python]()  # package Synthesize toolkit; Debug Python
count_3 = List.Count(list=curves@L2)
chop = List.Chop(list=byParameterOnCurveReference, lengths=count_3)
flatten_7 = List.Flatten(list=chop@L3)
empty = List.Empty()
scopeIf_3 = Custom[CW.ScopeIf+](VARtest=n04_connect_with_spline_by_points, VARtrue=flatten_7, VARfalse=empty)
end = Revit.Transaction.Transaction.End(input=scopeIf_3)
curvebypoints_byreferencepoints = Custom[CurveByPoints.ByReferencePoints Fixer](VARpoints=end, VARisReferenceLine=n05_is_reference)  # package Synthesize toolkit; CurveByPoints.ByReferencePoints Fixer
