# Dynamo graph Conceptual.DynaPoint Match Coordinates.dyn (Dynamo 2.13.1.3887)
# author: karam@aecedx.com
# packages: Synthesize toolkit 12.5.1

# group: Input
n01_select_reference_points = DSModelElementsSelection()  # "01.Select Reference Points"; nothing selected; graph input
n02_snapping_tollerance_in = DoubleInput(10)  # "02.Snapping Tollerance (In Millimeters)"; graph input
n03_pin_new = BoolSelector(false)  # "03.Pin New ?"; graph input
n04_delete_old = BoolSelector(false)  # "04.Delete Old ?"; graph input

dynapoints_match_coordination = Custom[DynaPoints Match Coordination](VARElements=n01_select_reference_points, VARSnappingTolleranceInMeters=n02_snapping_tollerance_in, VARPinNew=n03_pin_new, VARDeleteOld=n04_delete_old)  # package Synthesize toolkit; Adaptive Match Coordination
debug_python_no_message = Custom[Debug Python No Message]()  # package Synthesize toolkit; Debug Python
