# Dynamo graph Conceptual.DynaPoint Pull Onto Levels.dyn (Dynamo 2.13.1.3887)
# author: karam@aecedx.com
# packages: Synthesize toolkit 12.5.1

# group: Input
n01_select_reference_points = DSModelElementsSelection()  # "01.Select Reference Points"; nothing selected; graph input
n02_pin_after_pull = BoolSelector(false)  # "02.Pin After Pull ?"; graph input

python_script = Python(IN[0]=n01_select_reference_points, IN[1]=n02_pin_after_pull)  # IronPython2
# ---------- python_script.python (127 lines) ----------
# Created by Karam Baki: karam@aecedx.com
# Delivered to IBECE GROUP https://ibecegroup.com/

import clr
clr.AddReference('ProtoGeometry')
from Autodesk.DesignScript import Geometry as dg

# EXTENSION Enable ToDSType
clr.AddReference('RevitNodes')
import Revit

# Enable Revit API
clr.AddReference('RevitAPI')
from Autodesk.Revit.DB import *

# EXTENSION Enable Geometry Conversion Methods
clr.ImportExtensions(Revit.GeometryConversion)

# Enable DocumentManager and TransactionManager
clr.AddReference('RevitServices')
from RevitServices.Persistence import DocumentManager
from RevitServices.Transactions import TransactionManager

clr.AddReference("RevitAPIUI")
from Autodesk.Revit.UI import TaskDialog


class KaramSwallowSimple(IFailuresPreprocessor):
	def PreprocessFailures(self, failuresAccessor):
		failuresAccessor.DeleteAllWarnings()
		return FailureProcessingResult.Continue


def isplanarsurf(s):
	norms = [0,0.333,0.666,1]
	pts = []
	for n in norms:
		for n2 in norms:
			pts.append(dg.Surface.PointAtParameter(s,n,n2))
	plane = dg.Plane.ByBestFitThroughPoints(pts)
	status = True
	for p in pts:
		try:
			inter = dg.Geometry.DoesIntersect(p,plane)
			if inter == False:
				status = False
				break
		except:
			pass
	return status

def lvl_to_plane(doc,pt1,level,factor):
	level = doc.GetElement(level)
	plane = dg.Plane.ByOriginNormal(dg.Point.ByCoordinates(pt1.X,pt1.Y,level.ProjectElevation/factor),dg.Vector.ZAxis())
	return plane,level.GetPlaneReference()

def oldVersionDetect(doc,pt1,factor):
	levels = FilteredElementCollector(doc).OfCategory(BuiltInCategory.OST_Levels).WhereElementIsNotElementType().ToElementIds()
	planes = []
	for level in levels:
		planes.append(lvl_to_plane(doc,pt1,level,factor)[0])
	dises = []
	for plane in planes:
		dises.append(dg.Geometry.DistanceTo(plane,pt1))
	mindis = min(dises)
	count = 0
	for dis in dises:
		if mindis == dis:
			return levels[count]
		count += 1
		
def correctOP(doc,pt1,factor):
	if int(DocumentManager.Instance.CurrentUIApplication.Application.VersionNumber) > 2021:
		nearest1 = Level.GetNearestLevelId(doc,pt1.Z * factor)
	else:
		nearest1 = oldVersionDetect(doc,pt1,factor)
	lvl_to_planeOP = lvl_to_plane(doc,pt1,nearest1,factor)
	plane1 = lvl_to_planeOP[0]
	levelref = lvl_to_planeOP[1]
	corrected1 = dg.Geometry.ClosestPointTo(plane1,pt1)
	return corrected1,levelref

def FinalRefOP(corrected1,corrected1ref,xvec):
	pt1XYZ = corrected1.ToXyz()
	correctedRefPt1 = doc.FamilyCreate.NewReferencePoint(PointOnPlane.NewPointOnPlane(doc,corrected1ref,pt1XYZ,xvec))
	return correctedRefPt1

corrected = []
doc = DocumentManager.Instance.CurrentDBDocument
uidoc = DocumentManager.Instance.CurrentUIApplication.ActiveUIDocument
uiapp = DocumentManager.Instance.CurrentUIApplication
app = uiapp.Application

if int(DocumentManager.Instance.CurrentUIApplication.Application.VersionNumber) < 2021:
	factor = UnitUtils.ConvertToInternalUnits(1,doc.GetUnits().GetFormatOptions(UnitType.UT_Length).DisplayUnits)
else:
	factor = UnitUtils.ConvertToInternalUnits(1,doc.GetUnits().GetFormatOptions(SpecTypeId.Length).GetUnitTypeId())

refpts = UnwrapElement(IN[0])
pinnew = IN[1]

TransactionManager.Instance.ForceCloseTransaction()

trans = Transaction(doc, 'Fixing Points to Levels')
trans.Start()
warnhandle = KaramSwallowSimple()
foptions = trans.GetFailureHandlingOptions()
foptions.SetFailuresPreprocessor(warnhandle)
trans.SetFailureHandlingOptions(foptions)

result = []
for refpt in refpts:
	try:
		if hasattr(refpt, 'GetCoordinateSystem'):
			correctedOP1 = correctOP(doc,refpt.GetCoordinateSystem().ToCoordinateSystem().Origin,factor)
			result.append(correctedOP1)
			corrected1 = correctedOP1[0]
			corrected1ref = correctedOP1[1]
			refpt.SetPointElementReference(PointOnPlane.NewPointOnPlane(doc,corrected1ref,correctedOP1[0].ToXyz(),refpt.GetCoordinateSystem().BasisX))
			if pinnew:
				refpt.Pinned = True
			result.append(refpt)
	except:
		pass
trans.Commit()

OUT = result
# ----------------------------------------
debug_python_no_message = Custom[Debug Python No Message]()  # package Synthesize toolkit; Debug Python
