# Dynamo graph Conceptual.Face To Mass By All Elements of Active View.dyn (Dynamo 2.13.1.3887)
# author: karam@aecedx.com
# packages: Synthesize toolkit 12.5.1

# group: Input
n01_fetch_active_view_only = BoolSelector(true)  # "01.Fetch Active View Only Elements ?"; graph input
n02_mass_family_name = StringInput("Dynamo Converted Project")  # "02.Mass Family Name"; graph input
n03_mass_family_number = DoubleInput(1)  # "03.Mass Family Number"; graph input
n04_conceptual_mass_template_rft = Filename("..\..\..\..\..\..\..\..\..\..\ProgramData\Autodesk\RVT 2020\Family Templates\English\Conceptual Mass\Metric Mass.rft")  # "04.Conceptual Mass Template (.rft)"; graph input

python_all_elements_in_active = Custom[Python All Elements In Active View]()  # package Synthesize toolkit; Python All Elements In Active View
python_all_elements_in_all = Custom[Python All Elements In All Document]()  # package Synthesize toolkit; Python All Elements In All Document
scopeIf = Custom[CW.ScopeIf+](VARtest=n01_fetch_active_view_only, VARtrue=python_all_elements_in_active, VARfalse=python_all_elements_in_all)  # package Synthesize toolkit; A (hopefully) more robust implementation of ScopeIf. Tests a single boolean and returns a value accordingly.
python_script = Python(IN[0]=scopeIf, IN[1]=n02_mass_family_name)  # IronPython2
# ---------- python_script.python (18 lines) ----------
import clr
clr.AddReference('ProtoGeometry')
from Autodesk.DesignScript.Geometry import *
#The inputs to this node will be stored as a list in the IN variables.
dataEnteringNode = IN

elements = UnwrapElement(IN[0])
filter = IN[1]

result = []
for e in elements:
	try:
		if filter.lower() not in e.Name.lower():
			result.append(e)
	except:
		pass
#Assign your output to the OUT variable.
OUT = result
# ----------------------------------------
element_geometry_fast = Custom[Element.Geometry Fast](VARElements=python_script)  # package Synthesize toolkit; Element.Geometry Fast
flatten = List.Flatten(list=element_geometry_fast)
code_block = CodeBlock { false; }
family_category = Categories("OST_Mass")
smart_rft_path = Custom[Smart RFT Path](VARRFTFile=n04_conceptual_mass_template_rft, VARCategory=family_category)  # package Synthesize toolkit; Smart RFT Path
code_block_2 = CodeBlock { false; }
k_family_insert = Custom[K-Family Insert](VARGeometryorSAT=flatten, VARAvoidConfilct=code_block, VARFamilyName=n02_mass_family_name, VARFamilyNumber=n03_mass_family_number, VARFamilyCategory=family_category, VARFamilyTemplatePath=smart_rft_path, VARSelfOrigin=code_block_2)  # package Synthesize toolkit; K-Family Insert
flatten_2 = List.Flatten(list=k_family_insert.VARFamilyInstancesOrImportSymbols)
code_block_3 = CodeBlock { true; }
setPinnedStatus = Custom[RH.Element.SetPinnedStatus](VARelement=flatten_2, VARBool=code_block_3)  # package Synthesize toolkit; Will set the element to either pinned or not pinned. True is pinned, false is unpinned. For multiple elements use List.Map
debug_python_no_message = Custom[Debug Python No Message]()  # package Synthesize toolkit; Debug Python
