# Dynamo graph Conceptual.Face To Mass By Elements Selection - Updater.dyn (Dynamo 2.13.1.3887)
# author: karam@aecedx.com
# packages: Synthesize toolkit 12.5.1

# group: Input
n03_custom_family_template = Filename("..\..\..\..\..\..\..\..\..\..\ProgramData\Autodesk\RVT 2020\Family Templates\English\Conceptual Mass\Metric Mass.rft")  # "03.Custom Family Template : Conceptual Mass Template (.rft)"; graph input
n02_custom_family_template = BoolSelector(false)  # "02.Custom Family Template"; graph input
n01_unjoin_elements_prior_to = BoolSelector(false)  # "01.Unjoin Elements Prior to Extract"; graph input

categories = Categories("OST_Mass")
smart_rft_path = Custom[Smart RFT Path](VARRFTFile=n03_custom_family_template, VARCategory=categories)  # package Synthesize toolkit; Smart RFT Path
face_to_mass_updater = Custom[Face to Mass Updater](VARConceptualMassTemplate=smart_rft_path, VARCustomFamilyTemplate=n02_custom_family_template, VARUnjoinElements=n01_unjoin_elements_prior_to)  # package Synthesize toolkit; Face to Mass Updater
debug_python_no_message = Custom[Debug Python No Message]()  # package Synthesize toolkit; Debug Python
