# Dynamo graph Conceptual.Face To Mass By Elements Selection.dyn (Dynamo 2.13.1.3887)
# author: karam@aecedx.com
# packages: Synthesize toolkit 12.5.1

# group: Input
n01_select_elements_to_convert = DSModelElementsSelection()  # "01.Select Elements To Convert Into Mass"; nothing selected; graph input
n02_unjoin_elements_prior_to = BoolSelector(false)  # "02.Unjoin Elements Prior to Extract"; graph input
n03_mass_family_name = StringInput("Dynamo Converted Element")  # "03.Mass Family Name"; graph input
n04_conceptual_mass_template_rft = Filename("..\..\..\..\..\..\..\..\..\..\ProgramData\Autodesk\RVT 2020\Family Templates\English\Conceptual Mass\Metric Mass.rft")  # "04.Conceptual Mass Template (.rft)"; graph input

element_geometry_fixer = Custom[Element.Geometry Fixer](VARElement=n01_select_elements_to_convert, VARFullUnjoinedGeometry=n02_unjoin_elements_prior_to)  # package Synthesize toolkit; Element.Geometry Fixer
flatten = List.Flatten(list=element_geometry_fixer)
family_category = Categories("OST_Mass")
smart_rft_path = Custom[Smart RFT Path](VARRFTFile=n04_conceptual_mass_template_rft, VARCategory=family_category)  # package Synthesize toolkit; Smart RFT Path
code_block = CodeBlock { false; }
k_family_insert = Custom[K-Family Insert](VARGeometryorSAT=flatten, VARFamilyName=n03_mass_family_name, VARFamilyCategory=family_category, VARFamilyTemplatePath=smart_rft_path, VARSelfOrigin=code_block)  # package Synthesize toolkit; K-Family Insert
flatten_2 = List.Flatten(list=k_family_insert.VARFamilyInstancesOrImportSymbols)
code_block_2 = CodeBlock { true; }
setPinnedStatus = Custom[RH.Element.SetPinnedStatus](VARelement=flatten_2, VARBool=code_block_2)  # package Synthesize toolkit; Will set the element to either pinned or not pinned. True is pinned, false is unpinned. For multiple elements use List.Map
code_block_3 = CodeBlock { true; false; }
turnIntoList = Custom[CW.TurnIntoList](VARunknownItem=k_family_insert.VARFamilyInstancesOrImportSymbols)  # package Synthesize toolkit; Turns an element (or a nested list) into a flat list
python_script = Python(IN[0]=code_block_3.out0, IN[1]=n03_mass_family_name, IN[2]=k_family_insert.VARFamilyNumber, IN[3]=smart_rft_path, IN[4]=code_block_3.out1, IN[5]=turnIntoList, IN[6]=n01_select_elements_to_convert)  # IronPython2
# ---------- python_script.python (122 lines) ----------
# Enable Python support and load DesignScript library
# IMPORTANT : ALL DYNAMO DESIGN SCRIPT NODES ARE AS (dg)
import clr
clr.AddReference('ProtoGeometry')
from Autodesk.DesignScript import Geometry as dg

# EXTENSION Enable ToDSType
clr.AddReference('RevitNodes')
import Revit
clr.ImportExtensions(Revit.Elements)

# Enable Revit Elements
from Revit.Elements import *

# EXTENSION Enable Geometry Conversion Methods
clr.ImportExtensions(Revit.GeometryConversion)

# Enable Revit API
clr.AddReference('RevitAPI')
from Autodesk.Revit.DB import *

# Enable DocumentManager and TransactionManager
clr.AddReference('RevitServices')
from RevitServices.Persistence import DocumentManager
from RevitServices.Transactions import TransactionManager

# Enable ICollection List Translate
clr.AddReference("System")
import System.Collections.Generic
from System.Collections.Generic import List

def tolist(obj1):
	if hasattr(obj1,'__iter__'): return obj1
	else: return [obj1]

# Choose The Current Document
doc = DocumentManager.Instance.CurrentDBDocument
uidoc = DocumentManager.Instance.CurrentUIApplication.ActiveUIDocument
uiapp = DocumentManager.Instance.CurrentUIApplication
app = uiapp.Application

dataEnteringNode = IN
# Use UnwrapElement(IN[0]) When Translating From Dynamo to Revit

par0 = UnwrapElement(IN[0])
par1 = UnwrapElement(IN[1])
par2 = UnwrapElement(IN[2])
par3 = UnwrapElement(IN[3])
par4 = UnwrapElement(IN[4])
par5 = UnwrapElement(IN[5])

elems = par5

false = False
true = True

if par0 == false:
	par0 = "f"
elif par0 == true:
	par0 = "t"
	
if par4 == false:
	par4 = "f"
elif par4 == true:
	par4 = "t"

par3 = par3.replace(":","X1" )
par3 = par3.replace("\\","X2" )

# Create Empty List
result = []

tmplist = []
for each in elems:
	tmplist.append(str(each.Id))
joined = "-".join(tmplist)

#collect all views in the model
collector = FilteredElementCollector(doc)
filters = collector.OfClass(FilterElement).ToElements()
fnames = []
acceptedfilters = []
for each in filters:
	if each.ToString() == "Autodesk.Revit.DB.SelectionFilterElement":
		if each.IsEmpty() == False and "DONOTDELETE-FACETOMASS" in each.Name:
			fnames.append(each.Name)
			acceptedfilters.append(each)

if len(fnames) != 0:
	sequences = []
	for each in fnames:
		split = each.split(",")
		sequences.append(int(split[1]))
	uniqueseq = sorted(list(set(sequences)))
	lastseq = uniqueseq[-1] + 1
else:
	lastseq = 1

result = [par0] + [par1] + [str(par2)] + [par3] + [par4] + [joined]

joinedresult = ",".join(result)

filter1name = "DONOTDELETE-FACETOMASS," + str(lastseq) + "," + joinedresult

profs = UnwrapElement(IN[6])

profs = tolist(profs)

profset = []
# create itemset
ids = list()
for item in profs:
	ids.append(item.Id)
profset = List[ElementId](ids)

TransactionManager.Instance.EnsureInTransaction(doc)
selset1 = SelectionFilterElement.Create(doc,filter1name)
# add the items to the selection set
selset1.AddSet(profset)
TransactionManager.Instance.TransactionTaskDone()

OUT = selset1.ToDSType(False)
# ----------------------------------------
debug_python_no_message = Custom[Debug Python No Message]()  # package Synthesize toolkit; Debug Python
