# Dynamo graph Conceptual.Face To Mass By Pick Faces.dyn (Dynamo 2.13.1.3887)
# author: karam@aecedx.com
# packages: Synthesize toolkit 12.5.1

# group: Input
n01_select_faces = SelectFaces()  # "01.Select Faces"; nothing selected; graph input
n03_face_offset = DoubleInput(0)  # "03.Face Offset"; graph input
n02_join_adjacent_surfaces = BoolSelector(false)  # "02.Join Adjacent Surfaces"; graph input
n04_update_mode = BoolSelector(false)  # "04.Update Mode ?"; graph input
n05_mass_family_name = StringInput("Dynamo Converted Face")  # "05.Mass Family Name"; graph input
n06_mass_family_number = DoubleInput(1)  # "06.Mass Family Number"; graph input
n07_conceptual_mass_template_rft = Filename("..\..\..\..\..\..\..\..\..\..\ProgramData\Autodesk\RVT 2020\Family Templates\English\Conceptual Mass\Metric Mass.rft")  # "07.Conceptual Mass Template (.rft)"; graph input

surface_importer = Custom[Surface Importer](VARSurfaces=n01_select_faces)  # package Synthesize toolkit; Surface Importer Node
explode = Geometry.Explode(geometry=surface_importer)
flatten = List.Flatten(list=explode)
smart_surface_offset = Custom[Smart Surface Offset](VARSurfaces=flatten, VARDistances=n03_face_offset, VARJoinAdjacentSurfaces=n02_join_adjacent_surfaces)  # package Synthesize toolkit; Smart Surface Offset
join_adjacent_surfaces = Custom[Join Adjacent Surfaces](VARSurfaces=smart_surface_offset, VARJoinOrNot=n02_join_adjacent_surfaces)  # package Synthesize toolkit; Join Adjacent Surfaces
code_block = CodeBlock { true; false; }
ne = code_block.out0 != n04_update_mode
family_category = Categories("OST_Mass")
k_family_insert = Custom[K-Family Insert](VARGeometryorSAT=join_adjacent_surfaces, VARAvoidConfilct=ne, VARFamilyName=n05_mass_family_name, VARFamilyNumber=n06_mass_family_number, VARFamilyCategory=family_category, VARFamilyTemplatePath=n07_conceptual_mass_template_rft, VARSelfOrigin=code_block.out1)  # package Synthesize toolkit; K-Family Insert
code_block_2 = CodeBlock { true; }
setPinnedStatus = Custom[RH.Element.SetPinnedStatus](VARelement=k_family_insert.VARFamilyInstancesOrImportSymbols, VARBool=code_block_2)  # package Synthesize toolkit; Will set the element to either pinned or not pinned. True is pinned, false is unpinned. For multiple elements use List.Map
debug_python_no_message = Custom[Debug Python No Message]()  # package Synthesize toolkit; Debug Python
