# Dynamo graph Conceptual.Helix.dyn (Dynamo 2.13.1.3887)
# author: karam@aecedx.com
# packages: Synthesize toolkit 12.5.1

n03_end_ratio_of_curve = DoubleSlider(1, range=0..1 step 0.01)  # "03.End Ratio (Of Curve)"; graph input
n04_start_ratio_of_curve = DoubleSlider(0, range=0..1 step 0.01)  # "04.Start Ratio (Of Curve)"; graph input
n01_select_curves_single_curve = DSModelElementsSelection()  # "01.Select Curves (Single Curve Recommended)"; nothing selected; graph input
geometry = Element.Geometry(element=n01_select_curves_single_curve)
flatten = List.Flatten(list=geometry)
as_polycurve_bycurves = Custom[AS.[&] PolyCurve.ByCurves](VARcurves=flatten)  # package Synthesize toolkit; Create polycurves from an unordered list of curves.
code_block = CodeBlock { 0; 1; 0.01; }
range = Range(start=code_block.out0, end=code_block.out1, step=code_block.out2, lacing=Longest)
pointAtParameter = Curve.PointAtParameter(curve=as_polycurve_bycurves.VARpolyCurve@L1, param=range)
byPoints = NurbsCurve.ByPoints(points=pointAtParameter)
n05_turn_angle_more_for_squezing = DoubleInput(2000)  # "05.Turn Angle (More for Squezing)"; graph input
n08_start_angle = DoubleInput(0)  # "08.Start Angle"; graph input
n07_end_radius = DoubleInput(15)  # "07.End Radius"; graph input
n06_start_radius = DoubleInput(1)  # "06.Start Radius"; graph input
helixAtCurve = Custom[HelixAtCurve](VAREndParameter=n03_end_ratio_of_curve, VARStartParameter=n04_start_ratio_of_curve, VARcurve=byPoints@L1, VARTurnAngle=n05_turn_angle_more_for_squezing, VARStartAngle=n08_start_angle, VAREndRadius=n07_end_radius, VARStartRadius=n06_start_radius, lacing=Longest)  # package Synthesize toolkit
code_block_2 = CodeBlock { 0; 1; }
n09_divisions_number_of_points = DoubleInput(100)  # "09.Divisions (Number of Points) ?"; graph input
sequence = Sequence(start=code_block_2.out0, amount=n09_divisions_number_of_points, step=code_block_2.out1, lacing=Longest)
remapRange = Math.RemapRange(numbers=sequence, newMin=code_block_2.out0, newMax=code_block_2.out1)
pointAtParameter_2 = Curve.PointAtParameter(curve=helixAtCurve@L1, param=remapRange)
byPoint = ReferencePoint.ByPoint(pt=pointAtParameter_2)
n02_is_reference = BoolSelector(true)  # "02.Is Reference ?"; graph input
byReferencePoints = CurveByPoints.ByReferencePoints(points=byPoint, isReferenceLine=n02_is_reference)
debug_python = Custom[Debug Python]()  # package Synthesize toolkit; Debug Python
