# Dynamo graph Conceptual.Hide Invisible Elements.dyn (Dynamo 2.13.1.3887)
# author: karam@aecedx.com
# packages: Synthesize toolkit 12.5.1

# group: Input
n01_subcategory_to_move_invisible = StringInput("Dynamo Hidden Masses")  # "01.Subcategory to Move Invisible Masses Into"; graph input
n02_mode_false_hidden_true = BoolSelector(false)  # "02.Mode: False = Hidden | True = Visible"; graph input

python_script = Python(IN[0]=n01_subcategory_to_move_invisible, IN[1]=n02_mode_false_hidden_true)  # IronPython2
# ---------- python_script.python (83 lines) ----------
import clr
clr.AddReference('RevitAPI')
from Autodesk.Revit.DB import *
clr.AddReference('RevitServices')
from RevitServices.Persistence import DocumentManager
from RevitServices.Transactions import TransactionManager
clr.AddReference("RevitAPIUI")
from Autodesk.Revit.UI import TaskDialog

doc = DocumentManager.Instance.CurrentDBDocument

def changesubcat(doc,togolist,subcategory,hideit):
	if doc.IsFamilyDocument == True and subcategory != "" and subcategory != None:
		try:	
			subcat1 = subcategory
			current_fam_cat = doc.OwnerFamily.FamilyCategory
			sub_fec = current_fam_cat.SubCategories
			sub_cat = False
			for sub in sub_fec:
				if sub.Name.lower() == subcat1.lower():
					sub_cat = sub
					break
			if sub_cat == False:
				newsubcat = doc.Settings.Categories.NewSubcategory(current_fam_cat, subcat1)
				sub_cat = newsubcat
			for s2 in togolist:
				try:
					s2.Subcategory = sub_cat
				except:
					pass
			doc.ActiveView.SetCategoryHidden(sub_cat.Id,hideit)
		except: pass
	return "Done"

subcategory = IN[0]
hideit = IN[1]

if hideit:
	hideit = False
else:
	hideit = True

tohide = []

isgood = True

if doc.IsFamilyDocument == False:
	isgood = False
	title = "AECedx - Karam"
	TaskDialog.Show(title, "Works In Conceptual Mass Only")
	OUT = "Nothing to Do"
else:
	if doc.OwnerFamily.FamilyCategory.Name != "Mass":
		isgood =False
		title = "AECedx - Karam"
		TaskDialog.Show(title, "Works In Conceptual Mass Only")
	OUT = "Nothing to Do"
if isgood:
	sub_fec = doc.OwnerFamily.FamilyCategory.SubCategories
	for sub in sub_fec:
		if sub.Name.lower() == "form":
			defaultsubcat = sub.Id
			break
	
	TransactionManager.Instance.EnsureInTransaction(doc)
	collector = FilteredElementCollector(doc).WhereElementIsNotElementType().ToElements();
	for c in collector:
		param = c.LookupParameter("Visible")
		if param != None:
			if param.AsInteger() == 0:
				tohide.append(c)
			else:
				currentsubparam = c.LookupParameter("Subcategory")
				if currentsubparam != None:
					try:
						currentsub = doc.GetElement(currentsubparam.AsElementId()).Name == subcategory
						currentsubparam.Set(defaultsubcat)
					except:
						pass
	changesubcat(doc,tohide,subcategory,hideit)
	TransactionManager.Instance.TransactionTaskDone()
	
	OUT = tohide
# ----------------------------------------
debug_python_no_message = Custom[Debug Python No Message]()  # package Synthesize toolkit; Debug Python
