# Dynamo graph Conceptual.K-Slicer By Solid and Divided Path.dyn (Dynamo 2.13.1.3887)
# author: karam@aecedx.com
# packages: Synthesize toolkit 12.5.1

# group: Input
n09_union_pieces = BoolSelector(false)  # "09.Union Pieces ?"; graph input
thickness = DoubleInput(0.5)  # "04.Thickness"; graph input
n05_thicken_both_sides = BoolSelector(true)  # "05.Thicken Both Sides ?"; graph input
n03_select_solid = DSModelElementSelection()  # "03.Select Solid"; nothing selected; graph input
n01_select_divided_path = DSModelElementSelection()  # "01.Select Divided Path"; nothing selected; graph input
n02_divided_path_precision_in = DoubleInput(1)  # "02.Divided Path Precision (In Feet)"; graph input
n11_exclusion_threshold = DoubleInput(10)  # "11.Exclusion Threshold"; graph input
n10_one_family = BoolSelector(true)  # "10.One Family ?"; graph input
n12_family_name = StringInput("Dynamo Sliced Pieces")  # "12.Family Name"; graph input
n13_family_category = Categories("OST_GenericModel")  # "13.Family Category"; graph input
n15_family_template_of_the_above = Filename("..\..\..\ProgramData\Autodesk\RVT 2020\Family Templates\English\Metric Generic Model.rft")  # "15.Family Template of The Above Category"; graph input
material = StringInput("Default")  # "06.Material"; graph input
n08_material_single_parameter = BoolSelector(true)  # "08.Material: Single Parameter Only ?"; graph input
n07_material_is_instance = BoolSelector(false)  # "07.Material: Is Instance Parameter ?"; graph input
subcategory = StringInput("")  # "14.Subcategory"; graph input

element_geometry_fixer = Custom[Element.Geometry Fixer](VARElement=n03_select_solid)  # package Synthesize toolkit; Element.Geometry Fixer
solid_by_divided_path_slicer = Custom[Solid By Divided Path Slicer](VARUnionPieces=n09_union_pieces, VARthickness=thickness, VARthickenbothsides=n05_thicken_both_sides, VARGeometry=element_geometry_fixer, VARDividedPath=n01_select_divided_path, VARDividedPathPrecision=n02_divided_path_precision_in, VARExclusionThreshold=n11_exclusion_threshold)  # package Synthesize toolkit; Solid By Face Reference Slicer
flatten = List.Flatten(list=solid_by_divided_path_slicer)
k_family_insert = Custom[K-Family Insert](VARGeometryorSAT=flatten, VAROneFamily=n10_one_family, VARFamilyName=n12_family_name, VARFamilyCategory=n13_family_category, VARFamilyTemplatePath=n15_family_template_of_the_above, VARMaterialName=material, VARIsOneMaterial=n08_material_single_parameter, VARIsMaterialInstance=n07_material_is_instance, VARSubcategory=subcategory)  # package Synthesize toolkit; K-Family Insert
debug_python_no_message = Custom[Debug Python No Message]()  # package Synthesize toolkit; Debug Python
