# Dynamo graph Conceptual.K-Slicer By Surfaces and Intersecting Curves.dyn (Dynamo 2.13.1.3887)
# author: karam@aecedx.com
# packages: Synthesize toolkit 12.5.1

debug_python = Custom[Debug Python]()  # package Synthesize toolkit; Debug Python

# group: Input
n01_select_faces = SelectFaces()  # "01.Select Faces"; nothing selected; graph input
n02_select_intersecting_curves = DSModelElementsSelection()  # "02.Select Intersecting Curves"; nothing selected; graph input
n11_smooth_distancing = DoubleInput(1)  # "11.Smooth Distancing"; graph input
thickness = DoubleInput(0.5)  # "03.Thickness"; graph input
n09_union_pieces = BoolSelector(false)  # "09.Union Pieces ?"; graph input
depth = DoubleInput(0.25)  # "05.Depth"; graph input
n04_thicken_both_sides = BoolSelector(true)  # "04.Thicken Both Sides ?"; graph input
n10_one_family = BoolSelector(true)  # "10.One Family ?"; graph input
n12_family_name = StringInput("Dynamo Sliced Pieces")  # "12.Family Name"; graph input
n13_family_category = Categories("OST_GenericModel")  # "13.Family Category"; graph input
n15_family_template_of_the_above = Filename("..\..\..\ProgramData\Autodesk\RVT 2020\Family Templates\English\Metric Generic Model.rft")  # "15.Family Template of The Above Category"; graph input
material = StringInput("Default")  # "06.Material"; graph input
n08_material_single_parameter = BoolSelector(true)  # "08.Material: Single Parameter Only ?"; graph input
n07_material_is_instance = BoolSelector(false)  # "07.Material: Is Instance Parameter ?"; graph input
subcategory = StringInput("")  # "14.Subcategory"; graph input

surface_slicer = Custom[Surface Slicer](VARSurfaces=n01_select_faces, VARIntersectingElements=n02_select_intersecting_curves, VARPointsDistance=n11_smooth_distancing, VARWidth=thickness, VARUnionPieces=n09_union_pieces, VARDepth=depth, VARThickenBothSides=n04_thicken_both_sides)  # package Synthesize toolkit; Surface Slicer
flatten = List.Flatten(list=surface_slicer)
k_family_insert = Custom[K-Family Insert](VARGeometryorSAT=flatten, VAROneFamily=n10_one_family, VARFamilyName=n12_family_name, VARFamilyCategory=n13_family_category, VARFamilyTemplatePath=n15_family_template_of_the_above, VARMaterialName=material, VARIsOneMaterial=n08_material_single_parameter, VARIsMaterialInstance=n07_material_is_instance, VARSubcategory=subcategory)  # package Synthesize toolkit; K-Family Insert
