# Dynamo graph Conceptual.Lines Turn Off Model Lines Visiblity.dyn (Dynamo 2.13.1.3887)
# author: karam@aecedx.com
# packages: Synthesize toolkit 12.5.1

python_all_elements_in_active = Custom[Python All Elements In Active View]()  # package Synthesize toolkit; Python All Elements In Active View
code_block = CodeBlock { "ModelCurve"; "CurveByPoints"; "Is Reference Line"; "DividedPath"; "DividedSurface"; }
byClassName = Custom[SP.Filter.ByClassName](VARobject=python_all_elements_in_active, VARclassName=code_block.out0)  # package Synthesize toolkit; Filters a list of objects by the object's class name. Note that Dynamo elements belong to different classes than their Revit counterparts. Use the Object.Class node to check an object's class.
byClassName_2 = Custom[SP.Filter.ByClassName](VARobject=byClassName.VARout, VARclassName=code_block.out1)
create = List.Create(item0=byClassName_2.VARin, item1=byClassName.VARin)
code_block_2 = CodeBlock { false; }
clean = List.Clean(list=create, preserveIndices=code_block_2)
flatten = List.Flatten(list=clean)
getParameterValueByName = Element.GetParameterValueByName(element=flatten, parameterName=code_block.out2)
code_block_3 = CodeBlock { 0; }
eq = getParameterValueByName == code_block_3
filterByBoolMask = List.FilterByBoolMask(list=flatten, mask=eq)
code_block_4 = CodeBlock { false; }
clean_2 = List.Clean(list=filterByBoolMask.in, preserveIndices=code_block_4)
flatten_2 = List.Flatten(list=clean_2)
n01_false_off_visibility_true_on = BoolSelector(false)  # "01.False = Off Visibility | True = On Visibility (Will Also Affect Divided Paths & Adaptive Profile Families)"; graph input
byClassName_3 = Custom[SP.Filter.ByClassName](VARobject=byClassName_2.VARout, VARclassName=code_block.out3)
byClassName_4 = Custom[SP.Filter.ByClassName](VARobject=byClassName_3.VARout, VARclassName=code_block.out4)
python_script = Python(IN[0]=flatten_2, IN[1]=n01_false_off_visibility_true_on, IN[2]=byClassName_4.VARin, IN[3]=byClassName_4.VARout, IN[4]=byClassName_3.VARin)  # IronPython2
# ---------- python_script.python (169 lines) ----------
# Enable Python support and load DesignScript library
# IMPORTANT : ALL DYNAMO DESIGN SCRIPT NODES ARE AS (dg)
import clr
clr.AddReference('ProtoGeometry')
from Autodesk.DesignScript import Geometry as dg

# EXTENSION Enable ToDSType
clr.AddReference('RevitNodes')
import Revit
clr.ImportExtensions(Revit.Elements)

# Enable Revit Elements
from Revit.Elements import *

# EXTENSION Enable Geometry Conversion Methods
clr.ImportExtensions(Revit.GeometryConversion)

# Enable Revit API
clr.AddReference('RevitAPI')
from Autodesk.Revit.DB import *

# Enable DocumentManager and TransactionManager
clr.AddReference('RevitServices')
from RevitServices.Persistence import DocumentManager
from RevitServices.Transactions import TransactionManager

# Enable ICollection List Translate
clr.AddReference("System")
import System.Collections.Generic
from System.Collections.Generic import List

clr.AddReference("RevitAPIUI")
from Autodesk.Revit.UI import TaskDialog

def tolist(obj1):
	if hasattr(obj1,'__iter__'): return obj1
	else: return [obj1]

def flatten(x):
    result = []
    for el in x:
        if hasattr(el, "__iter__") and not isinstance(el, basestring):
            result.extend(flatten(el))
        else:
            result.append(el)
    return result

dataEnteringNode = IN
# Use UnwrapElement(IN[0]) When Translating From Dynamo to Revit
lines=UnwrapElement(tolist(IN[0]))
vistatus=IN[1]
alldivsurf = UnwrapElement(tolist(IN[2]))
leftovers = UnwrapElement(tolist(IN[3]))
divpaths = UnwrapElement(tolist(IN[4]))

# Choose The Current Document
doc = DocumentManager.Instance.CurrentDBDocument
uidoc = DocumentManager.Instance.CurrentUIApplication.ActiveUIDocument
uiapp = DocumentManager.Instance.CurrentUIApplication
app = uiapp.Application

if int(DocumentManager.Instance.CurrentUIApplication.Application.VersionNumber) > 2021:
	isfixed = True
else:
	isfixed = False

alert = TaskDialog
title = "AECedx - Karam"
if isfixed:
	alert.Show(title, "Script Is Not Needed Anymore\nThis Problem Has Been Fixed In Revit 2022 And Above")
else:
	alert.Show(title, "Please Install Latest Revit Version\nThis Problem Has Been Fixed In Revit 2022")

if isfixed == False:
	possible = []
	totest = []
	addedid = []
	for le in leftovers:
		if hasattr(le, 'Symbol'):
			symb = le.Symbol.Family
			symbid = symb.Id
			try:
				if symb.get_Parameter(BuiltInParameter.FAMILY_SHARED).AsInteger() == 0 and symbid not in addedid:
					possible.append(symb)
					totest.append(le)
					addedid.append(symbid)
			except:
				pass
	
	opt1 = Options()
	opt1.ComputeReferences = False
	confirmedlist = []
	count = 0
	for t in totest:
		allgeom = t.get_Geometry(opt1)
		for g in allgeom:
			geom = g.GetSymbolGeometry()
			break
		for g in geom:
			cont = g.ToString().lower()
			if "line" in cont or "arc" in cont or "ellipse" in cont:
				confirmedlist.append(possible[count])
				break
		count += 1
		
	allconfelms = []
	for c in confirmedlist:
		allconfelms.append([x for x in FilteredElementCollector(doc, doc.ActiveView.Id).OfClass(FamilyInstance).ToElements() if c.Name in x.Symbol.FamilyName])
	
	allconfelms = flatten(allconfelms)	
	conflines = []
	for l in lines:
		conflines.append(l)
		
	everything = conflines + allconfelms
	
	TransactionManager.Instance.EnsureInTransaction(doc)
	
	for f in divpaths:
		try:
			f.DisplayNodes = vistatus
		except:
			pass
	
	nosafe = []
	for each in everything:
		eachparams = each.GetOrderedParameters()
		safeline = False
		for e in eachparams:
			pname = e.Definition.Name
			if pname == "Visible":
				safeline = True
				e.Set(vistatus)
				break
		if safeline == True:
			pass
		if safeline == False:
			nosafe.append(each)
	
	nosafediv = []
	for divsurf in alldivsurf:
		if doc.GetElement(divsurf.GetTypeId()).ToString() == "Autodesk.Revit.DB.TilePattern":
			nosafediv.append(divsurf)
		else:
			pass
			
	allnosafe = nosafe + nosafediv
	
	if len(nosafe) != 0 or len(nosafediv) != 0:
		ilistofids = List[ElementId]()
		active = doc.ActiveView
		for i in allnosafe:
			ilistofids.Add(i.Id)
		active.IsolateElementsTemporary(ilistofids)
		uisel = uidoc.Selection
		uisel.SetElementIds(ilistofids)
		if len(nosafe) != 0 and len(nosafediv) == 0:
			msg = "Some faulty lines are isolated and selected, Please press CTRL+X then from Modify Tab > Paste Dropdown > Align to Same Place, then re-run the script again."
		elif len(nosafe) != 0 and len(nosafediv) != 0:
			msg = "Some faulty lines are isolated and selected, Please press CTRL+X then from Modify Tab > Paste Dropdown > Align to Same Place, then re-run the script again.\nAlso there is " + str(len(nosafediv)) + " Divided Surfaces do not contain pattern\nPlease assign a pattern or delete, or hide them using the 'Surface' toggle."
		elif len(nosafe) == 0 and len(nosafediv) != 0:
			msg = str(len(nosafediv)) + " Divided Surfaces do not contain pattern\nPlease assign a pattern or delete, or hide them using the 'Surface' toggle."
		alert.Show(title, msg)
		
	TransactionManager.Instance.TransactionTaskDone()
	# Assign your output to the OUT variable.
	OUT = "Done"
else:
	OUT = "Problem Fixed, Nothing to Do"
# ----------------------------------------
debug_python_no_message = Custom[Debug Python No Message]()  # package Synthesize toolkit; Debug Python
