# Dynamo graph Conceptual.Mass Floor SAT Lines Intersects By All or Filtered Levels.dyn (Dynamo 2.13.1.3887)
# author: karam@aecedx.com
# packages: Synthesize toolkit 12.5.1

# group: Input
n04_create_selection_filter = BoolSelector(true)  # "04.Create Selection Filter ?"; graph input
n05_mass_floor_lines_filter_name = StringInput("Dynamo Generated Mass Floor Lines")  # "05.Mass Floor Lines Filter Name"; graph input
n06_overwrite_existing_filter = BoolSelector(false)  # "06.Overwrite Existing Filter ? (False for Adding Elements)"; graph input
n01_all_levels_ignores_levels = BoolSelector(true)  # "01.All Levels (Ignores Levels Selection Filter)"; graph input
n02_levels_selection_filter_to = StringInput("Levels Filter Name")  # "02.Levels Selection Filter to Read"; graph input
n03_sat_file = Filename("No file selected.")  # "03.SAT File"; graph input

element_types = ElementTypes("Level")
all_elements_of_type = ElementsOfType(element_type=element_types)
hot_get_all_filter = Custom[HOT.Get All Filter]()  # package Synthesize toolkit; Get all Filter
eq = hot_get_all_filter.VARName == n02_levels_selection_filter_to
filterByBoolMask = List.FilterByBoolMask(list=hot_get_all_filter.VARElement, mask=eq)
elements = Custom[CW.SelectionSet.Elements](VARselectionSet=filterByBoolMask.in)  # package Synthesize toolkit; Retrieves all elements stored in a selection set
flatten = List.Flatten(list=elements)
scopeIf = Custom[CW.ScopeIf+](VARtest=n01_all_levels_ignores_levels, VARtrue=all_elements_of_type, VARfalse=flatten)  # package Synthesize toolkit; A (hopefully) more robust implementation of ScopeIf. Tests a single boolean and returns a value accordingly.
flatten_2 = List.Flatten(list=scopeIf)
better_geometry_importfromsat = Custom[Better Geometry.ImportFromSAT](VARSATFile=n03_sat_file)  # package Synthesize toolkit; Better Geometry.ImportFromSAT
explode = Geometry.Explode(geometry=better_geometry_importfromsat)
explode_2 = Geometry.Explode()  # unwired: geometry
map = List.Map(list=explode, f_x=explode_2)
mass_floor_lines_intersects = Custom[Mass Floor Lines Intersects](VARCreateSelectionFilter=n04_create_selection_filter, VARFilterNametoCreate=n05_mass_floor_lines_filter_name, VAROverwriteExistingFilter=n06_overwrite_existing_filter, VARLevels=flatten_2, VARSurfaces=map)  # package Synthesize toolkit; Mass Floor Lines Intersects
debug_python_no_message = Custom[Debug Python No Message]()  # package Synthesize toolkit; Debug Python
