# Dynamo graph Conceptual.Mass Floor SAT Lines Intersects By Custom Levels.dyn (Dynamo 2.13.1.3887)
# author: karam@aecedx.com
# packages: Synthesize toolkit 12.5.1

# group: Input
n03_create_selection_filter = BoolSelector(true)  # "03.Create Selection Filter ?"; graph input
n04_mass_floor_lines_filter_name = StringInput("Dynamo Generated Mass Floor Lines")  # "04.Mass Floor Lines Filter Name"; graph input
n05_overwrite_existing_filter = BoolSelector(false)  # "05.Overwrite Existing Filter ? (False for Adding Elements)"; graph input
n01_select_levels = DSModelElementsSelection()  # "01.Select Levels"; nothing selected; graph input
n02_sat_file = Filename("No file selected.")  # "02.SAT File"; graph input

better_geometry_importfromsat = Custom[Better Geometry.ImportFromSAT](VARSATFile=n02_sat_file)  # package Synthesize toolkit; Better Geometry.ImportFromSAT
explode = Geometry.Explode(geometry=better_geometry_importfromsat)
explode_2 = Geometry.Explode()  # unwired: geometry
map = List.Map(list=explode, f_x=explode_2)
mass_floor_lines_intersects = Custom[Mass Floor Lines Intersects](VARCreateSelectionFilter=n03_create_selection_filter, VARFilterNametoCreate=n04_mass_floor_lines_filter_name, VAROverwriteExistingFilter=n05_overwrite_existing_filter, VARLevels=n01_select_levels, VARSurfaces=map)  # package Synthesize toolkit; Mass Floor Lines Intersects
debug_python_no_message = Custom[Debug Python No Message]()  # package Synthesize toolkit; Debug Python
