# Dynamo graph Conceptual.Mass Join.dyn (Dynamo 2.13.1.3887)
# author: karam@aecedx.com
# packages: Synthesize toolkit 12.5.1

# group: Input
n01_select_masses = DSModelElementsSelection()  # "01.Select Masses"; nothing selected; graph input
n02_material_to_set = StringInput("Default Transparent")  # "02.Material to Set"; graph input

element_geometry_fixer = Custom[Element.Geometry Fixer](VARElement=n01_select_masses)  # package Synthesize toolkit; Element.Geometry Fixer
flatten = List.Flatten(list=element_geometry_fixer)
code_block = CodeBlock { "Solid"; "Surface"; }
byClassName = Custom[SP.Filter.ByClassName](VARobject=flatten, VARclassName=code_block.out0)  # package Synthesize toolkit; Filters a list of objects by the object's class name. Note that Dynamo elements belong to different classes than their Revit counterparts. Use the Object.Class node to check an object's class.
solid_byunion_fixer = Custom[Solid.ByUnion Fixer](VARsolids=byClassName.VARin)  # package Synthesize toolkit; Solid.ByUnion Fixer
byClassName_2 = Custom[SP.Filter.ByClassName](VARobject=flatten, VARclassName=code_block.out1)
join_adjacent_surfaces = Custom[Join Adjacent Surfaces](VARSurfaces=byClassName_2.VARin)  # package Synthesize toolkit; Join Adjacent Surfaces
create = List.Create(item0=solid_byunion_fixer, item1=join_adjacent_surfaces)
code_block_2 = CodeBlock { false; }
clean = List.Clean(list=create, preserveIndices=code_block_2)
flatten_2 = List.Flatten(list=clean)
code_block_3 = CodeBlock { "Joined Form"; }
dynamo_geometry_to_revit = Custom[Dynamo Geometry To Revit Compatibility](VARGeometryOrSat=flatten_2, VARMaterialName=n02_material_to_set, VARSubcategory=code_block_3)  # package Synthesize toolkit; Dynamo Geometry To Revit Compatibility
debug_python = Custom[Debug Python]()  # package Synthesize toolkit; Debug Python
