# Dynamo graph Conceptual.Mass Separate Multiple Massess By Solids or Surfaces.dyn "Conceptual.Mass Separate Multiple Massess By Solids or Surfaces (or Levels or Planes or Divided Paths)" (Dynamo 2.13.1.3887)
# author: karam@aecedx.com
# packages: Synthesize toolkit 12.5.1

debug_python = Custom[Debug Python]()  # package Synthesize toolkit; Debug Python

# group: Input
n01_select_multiple_masses_to = DSModelElementsSelection()  # "01.Select Multiple Masses to Split (Doesn't Work With Joined Masses)"; nothing selected; graph input
n02_select_splitting_solids = DSModelElementsSelection()  # "02.Select Splitting Solids/Surfaces"; nothing selected; graph input
n04_surfaces_or_planes_thicken = DoubleInput(0)  # "04.Surfaces or Planes Thicken Value"; graph input
n05_surfaces_or_planes_thicken = BoolSelector(true)  # "05.Surfaces or Planes Thicken Both Sides"; graph input
n03_material_to_set = StringInput("Default Transparent")  # "03.Material to Set"; graph input
n07_one_family_in_project = BoolSelector(true)  # "07.One Family ? (In Project Environment)"; graph input
n06_family_name_in_project = StringInput("Dynamo Separated Family")  # "06.Family Name (In Project Environment)"; graph input
n08_category_in_project = Categories("OST_Mass")  # "08.Category (In Project Environment)"; graph input
n09_family_template_of_the_above = Filename("..\..\..\..\..\..\..\..\..\..\ProgramData\Autodesk\RVT 2020\Family Templates\English\Conceptual Mass\Metric Mass.rft")  # "09.Family Template of The Above Category (In Project Environment)"; graph input

current = Document.Current()
isFamilyDocument = Document.IsFamilyDocument(document=current)
element_geometry_fixer = Custom[Element.Geometry Fixer](VARElement=n01_select_multiple_masses_to)  # package Synthesize toolkit; Element.Geometry Fixer
code_block = CodeBlock { "Solid"; }
byClassName = Custom[SP.Filter.ByClassName](VARobject=element_geometry_fixer, VARclassName=code_block)  # package Synthesize toolkit; Filters a list of objects by the object's class name. Note that Dynamo elements belong to different classes than their Revit counterparts. Use the Object.Class node to check an object's class.
python_empty_2_null = Custom[Python Empty 2 Null](VARIN=byClassName.VARout)  # package Synthesize toolkit; Python Null 2 Empty
code_block_2 = CodeBlock { "Surface"; }
byClassName_2 = Custom[SP.Filter.ByClassName](VARobject=python_empty_2_null, VARclassName=code_block_2)
create = List.Create(item0=byClassName.VARin, item1=byClassName_2.VARin)
code_block_3 = CodeBlock { false; }
clean = List.Clean(list=create, preserveIndices=code_block_3)
flatten = List.Flatten(list=clean)
code_block_4 = CodeBlock { "Surface"; }
byClassName_3 = Custom[SP.Filter.ByClassName](VARobject=flatten, VARclassName=code_block_4)
byJoinedSurfaces = PolySurface.ByJoinedSurfaces(surfaces=byClassName_3.VARin@L1)
flatten_2 = List.Flatten(list=byJoinedSurfaces)
element_geometry_fixer_2 = Custom[Element.Geometry Fixer](VARElement=n02_select_splitting_solids)
code_block_5 = CodeBlock { "Solid"; }
byClassName_4 = Custom[SP.Filter.ByClassName](VARobject=element_geometry_fixer_2, VARclassName=code_block_5)
python_empty_2_null_2 = Custom[Python Empty 2 Null](VARIN=byClassName_4.VARout)
code_block_6 = CodeBlock { "Surface"; }
byClassName_5 = Custom[SP.Filter.ByClassName](VARobject=python_empty_2_null_2, VARclassName=code_block_6)
join_adjacent_surfaces_legacy = Custom[Join Adjacent Surfaces Legacy](VARSurfaces=byClassName_5.VARin@L2)  # package Synthesize toolkit; Join Adjacent Surfaces
reference_planes_to_surfaces = Custom[Reference Planes to Surfaces](VARPlanes=n02_select_splitting_solids)  # package Synthesize toolkit; Reference Planes to Surfaces
levels_to_surfaces = Custom[Levels to Surfaces](VARLevels=n02_select_splitting_solids)  # package Synthesize toolkit; Reference Planes to Surfaces
dividedpaths_to_surfaces = Custom[DividedPaths to Surfaces](VARLevels=n02_select_splitting_solids)  # package Synthesize toolkit; Reference Planes to Surfaces
create_2 = List.Create(item0=byClassName_4.VARin, item1=join_adjacent_surfaces_legacy, item2=reference_planes_to_surfaces, item3=levels_to_surfaces, item4=dividedpaths_to_surfaces)
code_block_7 = CodeBlock { false; }
clean_2 = List.Clean(list=create_2, preserveIndices=code_block_7)
flatten_3 = List.Flatten(list=clean_2)
smart_thicken = Custom[Smart Thicken](VARGeometries=flatten_3, VARThickness=n04_surfaces_or_planes_thicken, VARBothSides=n05_surfaces_or_planes_thicken)  # package Synthesize toolkit; Smart Thicken
as_polysurface_splitbytools = Custom[AS.[&] PolySurface.SplitByTools](VARpolySurface=flatten_2, VARtools=smart_thicken)  # package Synthesize toolkit; Split a single polysurface with multiple tools.
as_geometry_splitbytools = Custom[AS.[&] Geometry.SplitByTools](VARgeometry=byClassName_3.VARout, VARtools=smart_thicken)  # package Synthesize toolkit; Split one piece of geometry (other than a polysurface) by multiple tools
create_3 = List.Create(item0=as_polysurface_splitbytools, item1=as_geometry_splitbytools)
code_block_8 = CodeBlock { false; }
clean_3 = List.Clean(list=create_3, preserveIndices=code_block_8)
flatten_4 = List.Flatten(list=clean_3)
empty = List.Empty()
scopeIf = Custom[CW.ScopeIf+](VARtest=isFamilyDocument, VARtrue=flatten_4, VARfalse=empty)  # package Synthesize toolkit; A (hopefully) more robust implementation of ScopeIf. Tests a single boolean and returns a value accordingly.
code_block_9 = CodeBlock { "Separated Form"; }
dynamo_geometry_to_revit = Custom[Dynamo Geometry To Revit Compatibility](VARGeometryOrSat=scopeIf, VARMaterialName=n03_material_to_set, VARSubcategory=code_block_9)  # package Synthesize toolkit; Dynamo Geometry To Revit Compatibility
try_to_hide_elements_in_mass = Custom[Try to Hide Elements In Mass Only](VARElements=n01_select_multiple_masses_to, VARWait=dynamo_geometry_to_revit)  # package Synthesize toolkit; Try to Hide Elements
scopeIf_2 = Custom[CW.ScopeIf+](VARtest=isFamilyDocument, VARtrue=empty, VARfalse=flatten_4)
smart_rft_path = Custom[Smart RFT Path](VARRFTFile=n09_family_template_of_the_above, VARCategory=n08_category_in_project)  # package Synthesize toolkit; Smart RFT Path
code_block_10 = CodeBlock { false; }
k_family_insert = Custom[K-Family Insert](VARGeometryorSAT=scopeIf_2, VAROneFamily=n07_one_family_in_project, VARFamilyName=n06_family_name_in_project, VARFamilyCategory=n08_category_in_project, VARFamilyTemplatePath=smart_rft_path, VARMaterialName=n03_material_to_set, VARSelfOrigin=code_block_10)  # package Synthesize toolkit; K-Family Insert
