# Dynamo graph Conceptual.Mass Split All Elements of Active View By Lines.dyn (Dynamo 2.13.1.3887)
# author: karam@aecedx.com
# packages: Synthesize toolkit 12.5.1

debug_python = Custom[Debug Python]()  # package Synthesize toolkit; Debug Python
python_all_elements_in_active = Custom[Python All Elements In Active View]()  # package Synthesize toolkit; Python All Elements In Active View

# group: Input
n01_select_splitting_lines = DSModelElementsSelection()  # "01.Select Splitting Lines"; nothing selected; graph input
n04_options_splitter_thickness = DoubleInput(0.1)  # "04.Options : Splitter Thickness"; graph input
n03_options_detection_tollerate = DoubleInput(0.5)  # "03.Options : Detection Tollerate"; graph input
n05_options_split_extend_distance = DoubleInput(1)  # "05.Options : Split Extend Distance"; graph input
n06_options_points_distancing = DoubleInput(0.5)  # "06.Options : Points Distancing"; graph input
n02_options_pull_curves_onto = BoolSelector(false)  # "02.Options : Pull Curves Onto Surfaces ?"; graph input
n07_family_name = StringInput("Dynamo Splitted Mass")  # "07.Family Name"; graph input
n08_family_category = Categories("OST_Mass")  # "08.Family Category"; graph input
n09_family_template_of_the_above = Filename("..\..\..\..\..\..\..\..\..\..\ProgramData\Autodesk\RVT 2020\Family Templates\English\Conceptual Mass\Metric Mass.rft")  # "09.Family Template of The Above Category"; graph input

turnIntoList = Custom[CW.TurnIntoList](VARunknownItem=n01_select_splitting_lines)  # package Synthesize toolkit; Turns an element (or a nested list) into a flat list
removeListFromList = Custom[RH.RemoveListFromList](VARListA=python_all_elements_in_active, VARListB=turnIntoList)  # package Synthesize toolkit; This node essentially "subtracts" the contents of List B from List A to produce a new list with the unique items.
mass_split = Custom[Mass Split](VARSplitterThickness=n04_options_splitter_thickness, VARDetectionTollerance=n03_options_detection_tollerate, VARSplitExtendDistance=n05_options_split_extend_distance, VARPointsDistancing=n06_options_points_distancing, VARPullOrNot=n02_options_pull_curves_onto, VARElements=removeListFromList, VARSplittingLines=n01_select_splitting_lines)  # package Synthesize toolkit; Mass Split
k_family_insert = Custom[K-Family Insert](VARGeometryorSAT=mass_split, VARFamilyName=n07_family_name, VARFamilyCategory=n08_family_category, VARFamilyTemplatePath=n09_family_template_of_the_above)  # package Synthesize toolkit; K-Family Insert
python_script = Python(IN[0]=removeListFromList, IN[1]=n01_select_splitting_lines, IN[2]=k_family_insert.VARFamilyInstancesOrImportSymbols)  # IronPython2
# ---------- python_script.python (109 lines) ----------
# Enable Python support and load DesignScript library
# IMPORTANT : ALL DYNAMO DESIGN SCRIPT NODES ARE AS (dg)
import clr
clr.AddReference('ProtoGeometry')
from Autodesk.DesignScript import Geometry as dg

# EXTENSION Enable ToDSType
clr.AddReference('RevitNodes')
import Revit
clr.ImportExtensions(Revit.Elements)

# Enable Revit Elements
from Revit.Elements import *

# EXTENSION Enable Geometry Conversion Methods
clr.ImportExtensions(Revit.GeometryConversion)

# Enable Revit API
clr.AddReference('RevitAPI')
from Autodesk.Revit.DB import *

# Enable DocumentManager and TransactionManager
clr.AddReference('RevitServices')
from RevitServices.Persistence import DocumentManager
from RevitServices.Transactions import TransactionManager

# Enable ICollection List Translate
clr.AddReference("System")
import System.Collections.Generic
from System.Collections.Generic import List

def tolist(obj1):
	if hasattr(obj1,'__iter__'): return obj1
	else: return [obj1]

# Choose The Current Document
doc = DocumentManager.Instance.CurrentDBDocument
uidoc = DocumentManager.Instance.CurrentUIApplication.ActiveUIDocument
uiapp = DocumentManager.Instance.CurrentUIApplication
app = uiapp.Application

dataEnteringNode = IN
# Use UnwrapElement(IN[0]) When Translating From Dynamo to Revit

forms = UnwrapElement(tolist(IN[0]))
splitters = UnwrapElement(tolist(IN[1]))


# Create Empty List
result = []

tmplist = []
for each in forms:
	tmplist.append(str(each.Id))
joined = "-".join(tmplist)

tmplist = []
for each in splitters:
	tmplist.append(str(each.Id))
joined2 = "-".join(tmplist)

joinedall = joined + "_" + joined2

#collect all views in the model
collector = FilteredElementCollector(doc)
filters = collector.OfClass(FilterElement).ToElements()
fnames = []
acceptedfilters = []
for each in filters:
	if each.ToString() == "Autodesk.Revit.DB.SelectionFilterElement":
		if each.IsEmpty() == False and "DONOTDELETE-DYNAMOSPLIT" in each.Name:
			fnames.append(each.Name)
			acceptedfilters.append(each)

if len(fnames) != 0:
	sequences = []
	for each in fnames:
		split = each.split(",")
		sequences.append(int(split[2]))
	uniqueseq = sorted(list(set(sequences)))
	lastseq = uniqueseq[-1] + 1
else:
	lastseq = 1

filter1name = "DONOTDELETE-DYNAMOSPLIT," + joinedall + "," + str(lastseq)

profs = UnwrapElement(tolist(IN[2]))

profset = []
# create itemset
ids = list()
for item in profs:
	ids.append(item.Id)
profset = List[ElementId](ids)

TransactionManager.Instance.EnsureInTransaction(doc)
try:
	selset1 = SelectionFilterElement.Create(doc,filter1name)
except:
	for each in filters:
		if each.ToString() == "Autodesk.Revit.DB.SelectionFilterElement":
			if filter1name == each.Name:
				selset1 = each
				selset1.Clear()
# add the items to the selection set
selset1.AddSet(profset)
TransactionManager.Instance.TransactionTaskDone()

OUT = selset1.ToDSType(False)
# ----------------------------------------
try_to_hide_elements_in_mass = Custom[Try to Hide Elements In Mass Only](VARElements=removeListFromList, VARWait=k_family_insert.VARFamilyInstancesOrImportSymbols)  # package Synthesize toolkit; Try to Hide Elements
