# Dynamo graph Conceptual.Nurbs Surface By Faces Selection.dyn (Dynamo 2.13.1.3887)
# author: karam@aecedx.com
# packages: Synthesize toolkit 12.5.1

# group: Input
n01_select_faces = SelectFaces()  # "01.Select Faces"; nothing selected; graph input
material = StringInput("")  # "02.Material"; graph input

toNurbsSurface = Surface.ToNurbsSurface(surface=n01_select_faces)
code_block = CodeBlock { "Full Nurbs Surface"; }
dynamo_geometry_to_revit = Custom[Dynamo Geometry To Revit Compatibility](VARGeometryOrSat=toNurbsSurface, VARMaterialName=material, VARSubcategory=code_block)  # package Synthesize toolkit; Dynamo Geometry To Revit Compatibility
debug_python_no_message = Custom[Debug Python No Message]()  # package Synthesize toolkit; Debug Python
