# Dynamo graph Conceptual.Patch By Edges.dyn (Dynamo 2.13.1.3887)
# author: karam@aecedx.com
# packages: Synthesize toolkit 12.5.1

debug_python_no_message = Custom[Debug Python No Message]()  # package Synthesize toolkit; Debug Python

# group: Input
n01_select_edges = SelectEdges()  # "01.Select Edges"; nothing selected; graph input
n02_mass_family_name = StringInput("Dynamo Generated Patch")  # "02.Mass Family Name"; graph input
n03_start_sequence_naming_suffix = DoubleInput(1)  # "03.Start Sequence (Naming Suffix)"; graph input
n04_conceptual_mass_template_rft = Filename("..\..\..\..\..\..\..\..\..\..\ProgramData\Autodesk\RVT 2020\Family Templates\English\Conceptual Mass\Metric Mass.rft")  # "04.Conceptual Mass Template (.rft)"; graph input
n05_method_false_imported_object = BoolSelector(true)  # "05.Method : False = Imported Object | True = Mass Family"; graph input

flatten = List.Flatten(list=n01_select_edges)
as_polycurve_bycurves = Custom[AS.[&] PolyCurve.ByCurves](VARcurves=flatten)  # package Synthesize toolkit; Create polycurves from an unordered list of curves.
closeWithLine = PolyCurve.CloseWithLine(polyCurve=as_polycurve_bycurves.VARpolyCurve)
byPatch = Surface.ByPatch(closedCurve=closeWithLine)
code_block = CodeBlock { false; }
clean = List.Clean(list=byPatch, preserveIndices=code_block)
flatten_2 = List.Flatten(list=clean)
categories = Categories("OST_Mass")
code_block_2 = CodeBlock { true; }
ne = code_block_2 != n05_method_false_imported_object
k_family_insert = Custom[K-Family Insert](VARGeometryorSAT=flatten_2, VARFamilyName=n02_mass_family_name, VARFamilyNumber=n03_start_sequence_naming_suffix, VARFamilyCategory=categories, VARFamilyTemplatePath=n04_conceptual_mass_template_rft, VARImportInstanceInstead=ne)  # package Synthesize toolkit; K-Family Insert
