# Dynamo graph Conceptual.Revolve Lines.dyn (Dynamo 2.13.1.3887)
# author: karam@aecedx.com
# packages: Synthesize toolkit 12.5.1

# group: Input
n04_start_angle = DoubleInput(0)  # "04.Start Angle"; graph input
n05_end_angle = DoubleInput(360)  # "05.End Angle"; graph input
n02_select_profile_s = DSModelElementsSelection()  # "02.Select Profile(s)"; nothing selected; graph input
n01_select_axis_line_s = DSModelElementsSelection()  # "01.Select Axis Line(s)"; nothing selected; graph input
n03_get_solids = BoolSelector(false)  # "03.Get Solids ?"; graph input
n06_mass_family_name = StringInput("Dynamo Generated Face")  # "06.Mass Family Name"; graph input
n07_start_sequence_naming_suffix = DoubleInput(1)  # "07.Start Sequence (Naming Suffix)"; graph input
n08_conceptual_mass_template_rft = Filename("..\..\..\..\..\..\..\..\..\..\ProgramData\Autodesk\RVT 2020\Family Templates\English\Conceptual Mass\Metric Mass.rft")  # "08.Conceptual Mass Template (.rft)"; graph input
n09_method_false_imported_object = BoolSelector(true)  # "09.Method : False = Imported Object | True = Mass Family"; graph input

curves = Element.Curves(element=n02_select_profile_s)
curves_2 = Element.Curves(element=n01_select_axis_line_s)
revolve_direct = Custom[Revolve Direct](VARstartAngle=n04_start_angle, VARsweepAngle=n05_end_angle, VARProfiles=curves, VARAxis=curves_2, VARGetSolids=n03_get_solids)  # package Synthesize toolkit; Revolve Direct
code_block = CodeBlock { 1; }
chop = List.Chop(list=revolve_direct, lengths=code_block)
count = List.Count(list=revolve_direct)
code_block_2 = CodeBlock { 1; }
sequence = Sequence(start=n07_start_sequence_naming_suffix, amount=count, step=code_block_2, lacing=Longest)
family_category = Categories("OST_Mass")
code_block_3 = CodeBlock { true; }
ne = code_block_3 != n09_method_false_imported_object
k_family_insert = Custom[K-Family Insert](VARGeometryorSAT=chop, VARFamilyName=n06_mass_family_name, VARFamilyNumber=sequence, VARFamilyCategory=family_category, VARFamilyTemplatePath=n08_conceptual_mass_template_rft, VARImportInstanceInstead=ne)  # package Synthesize toolkit; K-Family Insert
debug_python_no_message = Custom[Debug Python No Message]()  # package Synthesize toolkit; Debug Python
