# Dynamo graph Conceptual.Scale All Elements of Active View.dyn (Dynamo 2.13.1.3887)
# author: karam@aecedx.com
# packages: Synthesize toolkit 12.5.1

code_block = CodeBlock { true; false; }

# group: Input
n08_family_name = StringInput("Dynamo Scaled Mass")  # "08.Family Name"; graph input
n03_new_x = DoubleInput(1)  # "03.New X"; graph input
n02_old_x = DoubleInput(1)  # "02.Old X"; graph input
n05_new_y = DoubleInput(1)  # "05.New Y"; graph input
n04_old_y = DoubleInput(1)  # "04.Old Y"; graph input
n07_new_z = DoubleInput(1)  # "07.New Z"; graph input
n06_old_z = DoubleInput(1)  # "06.Old Z"; graph input
n01_keep_adjacet_surface_joined = BoolSelector(true)  # "01.Keep Adjacet Surface Joined"; graph input
n09_family_category = Categories("OST_Mass")  # "09.Family Category"; graph input
n10_family_template_of_the_above = Filename("..\..\..\..\..\..\..\..\..\..\ProgramData\Autodesk\RVT 2020\Family Templates\English\Conceptual Mass\Metric Mass.rft")  # "10.Family Template of The Above Category"; graph input

python_all_elements_in_active = Custom[Python All Elements In Active View]()  # package Synthesize toolkit; Python All Elements In Active View
element_geometry_fast = Custom[Element.Geometry Fast](VARElements=python_all_elements_in_active)  # package Synthesize toolkit; Element.Geometry Fast
flatten = List.Flatten(list=element_geometry_fast)
div = n03_new_x / n02_old_x
div_2 = n05_new_y / n04_old_y
div_3 = n07_new_z / n06_old_z
smart_geometry_scale = Custom[Smart Geometry Scale](VARGeometry=flatten, VARXAmount=div, VARYAmount=div_2, VARZAmount=div_3)  # package Synthesize toolkit; Smart Geometry Scale
flatten_2 = List.Flatten(list=smart_geometry_scale)
code_block_2 = CodeBlock { "Surface"; "Autodesk.DesignScript.Geometry.Solid"; }
byClassName = Custom[SP.Filter.ByClassName](VARobject=flatten_2, VARclassName=code_block_2.out0)  # package Synthesize toolkit; Filters a list of objects by the object's class name. Note that Dynamo elements belong to different classes than their Revit counterparts. Use the Object.Class node to check an object's class.
byClassName_2 = Custom[SP.Filter.ByClassName](VARobject=byClassName.VARout, VARclassName=code_block_2.out1)
join_adjacent_surfaces_legacy = Custom[Join Adjacent Surfaces Legacy](VARSurfaces=byClassName.VARin, VARJoinOrNot=n01_keep_adjacet_surface_joined)  # package Synthesize toolkit; Join Adjacent Surfaces
create = List.Create(item0=byClassName_2.VARin, item1=join_adjacent_surfaces_legacy)
code_block_3 = CodeBlock { false; }
clean = List.Clean(list=create, preserveIndices=code_block_3)
flatten_3 = List.Flatten(list=clean)
smart_rft_path = Custom[Smart RFT Path](VARRFTFile=n10_family_template_of_the_above, VARCategory=n09_family_category)  # package Synthesize toolkit; Smart RFT Path
code_block_4 = CodeBlock { false; }
k_family_insert = Custom[K-Family Insert](VARGeometryorSAT=flatten_3, VARFamilyName=n08_family_name, VARFamilyCategory=n09_family_category, VARFamilyTemplatePath=smart_rft_path, VARSelfOrigin=code_block_4)  # package Synthesize toolkit; K-Family Insert
turnIntoList = Custom[CW.TurnIntoList](VARunknownItem=k_family_insert.VARFamilyInstancesOrImportSymbols)  # package Synthesize toolkit; Turns an element (or a nested list) into a flat list
python_script = Python(IN[0]=code_block.out0, IN[1]=n08_family_name, IN[2]=k_family_insert.VARFamilyNumber, IN[3]=smart_rft_path, IN[4]=code_block.out1, IN[5]=python_all_elements_in_active, IN[6]=div, IN[7]=div_2, IN[8]=div_3, IN[9]=turnIntoList)  # IronPython2
# ---------- python_script.python (133 lines) ----------
# Enable Python support and load DesignScript library
# IMPORTANT : ALL DYNAMO DESIGN SCRIPT NODES ARE AS (dg)
import clr
clr.AddReference('ProtoGeometry')
from Autodesk.DesignScript import Geometry as dg

# EXTENSION Enable ToDSType
clr.AddReference('RevitNodes')
import Revit
clr.ImportExtensions(Revit.Elements)

# Enable Revit Elements
from Revit.Elements import *

# EXTENSION Enable Geometry Conversion Methods
clr.ImportExtensions(Revit.GeometryConversion)

# Enable Revit API
clr.AddReference('RevitAPI')
from Autodesk.Revit.DB import *

# Enable DocumentManager and TransactionManager
clr.AddReference('RevitServices')
from RevitServices.Persistence import DocumentManager
from RevitServices.Transactions import TransactionManager

# Enable ICollection List Translate
clr.AddReference("System")
import System.Collections.Generic
from System.Collections.Generic import List

def tolist(obj1):
	if hasattr(obj1,'__iter__'): return obj1
	else: return [obj1]

# Choose The Current Document
doc = DocumentManager.Instance.CurrentDBDocument
uidoc = DocumentManager.Instance.CurrentUIApplication.ActiveUIDocument
uiapp = DocumentManager.Instance.CurrentUIApplication
app = uiapp.Application

dataEnteringNode = IN
# Use UnwrapElement(IN[0]) When Translating From Dynamo to Revit

par0 = UnwrapElement(IN[0])
par1 = UnwrapElement(IN[1])
par2 = UnwrapElement(IN[2])
par3 = UnwrapElement(IN[3])
par4 = UnwrapElement(IN[4])
xm = IN[6]
ym = IN[7]
zm = IN[8]

false = False
true = True

if par0 == false:
	par0 = "f"
elif par0 == true:
	par0 = "t"
	
if par4 == false:
	par4 = "f"
elif par4 == true:
	par4 = "t"

par3 = par3.replace(":","X1" )
par3 = par3.replace("\\","X2" )

# Create Empty List
result = []

elems = UnwrapElement(IN[9])

tmplist = []
for each in elems:
	tmplist.append(str(each.Id))
joined = "-".join(tmplist)

#collect all views in the model
collector = FilteredElementCollector(doc)
filters = collector.OfClass(FilterElement).ToElements()
fnames = []
acceptedfilters = []
for each in filters:
	if each.ToString() == "Autodesk.Revit.DB.SelectionFilterElement":
		if each.IsEmpty() == False and "DONOTDELETE-DYNAMOSCALE" in each.Name:
			fnames.append(each.Name)
			acceptedfilters.append(each)

if len(fnames) != 0:
	sequences = []
	for each in fnames:
		split = each.split(",")
		sequences.append(int(split[1]))
	uniqueseq = sorted(list(set(sequences)))
	lastseq = uniqueseq[-1] + 1
else:
	lastseq = 1

result = [par0] + [par1] + [str(par2)] + [par3] + [par4] + [str(xm)] + [str(ym)] + [str(zm)] + [joined]

joinedresult = ",".join(result)

filter1name = "DONOTDELETE-DYNAMOSCALE," + str(lastseq) + "," + joinedresult

profs = UnwrapElement(IN[5])

profs = tolist(profs)

profset = []
# create itemset
ids = list()
for item in profs:
	ids.append(item.Id)
profset = List[ElementId](ids)

TransactionManager.Instance.EnsureInTransaction(doc)
selset1 = SelectionFilterElement.Create(doc,filter1name)
# add the items to the selection set
selset1.AddSet(profset)

for each in elems:
	currentparams = "Comments"
	eachparams = each.GetOrderedParameters()
	for e in eachparams:
		pname = e.Definition.Name.lower()
		if pname == currentparams.lower():
			e.Set(joined)

TransactionManager.Instance.TransactionTaskDone()

OUT = selset1.ToDSType(False)
# ----------------------------------------
try_to_hide_elements_in_mass = Custom[Try to Hide Elements In Mass Only](VARElements=python_all_elements_in_active, VARWait=k_family_insert.VARFamilyInstancesOrImportSymbols)  # package Synthesize toolkit; Try to Hide Elements
debug_python_no_message = Custom[Debug Python No Message]()  # package Synthesize toolkit; Debug Python
