# Dynamo graph Conceptual.T-Spline Pipes By Pulled Lines On Surfaces Selection.dyn (Dynamo 2.13.1.3887)
# author: karam@aecedx.com
# packages: Synthesize toolkit 12.5.1

debug_python_no_message = Custom[Debug Python No Message]()  # package Synthesize toolkit; Debug Python

# group: Input
n11_export_tsm = BoolSelector(false)  # "11.Export TSM ?"; graph input
n02_fetch_whole_body = BoolSelector(false)  # "02.Fetch Whole Body ?"; graph input
n01_select_faces = SelectFaces()  # "01.Select Faces"; nothing selected; graph input
n03_faces_filter_1_vertical_faces = IntegerSlider(4, range=1..4 step 1)  # "03.Faces Filter (1 = Vertical Faces | 2 = Horizontal Up Faces | 3 = Horizontal Down Faces | 4 = All Faces)"; graph input
n04_select_curves_or_divided = DSModelElementsSelection()  # "04.Select Curves or Divided Paths"; nothing selected; graph input
n08_simple_radius = DoubleInput(0.5)  # "08.Simple: Radius"; graph input
n05_snapping_tolerance = DoubleInput(0.001)  # "05.Snapping Tolerance"; graph input
n06_joints_sharpness = DoubleInput(2)  # "06.Joints Sharpness"; graph input
n07_method_simple_false_advanced = BoolSelector(false)  # "07.Method : Simple = False | Advanced = True"; graph input
n09_advanced_start_radius = DoubleInput(0.5)  # "09.Advanced: Start Radius"; graph input
n10_advanced_end_radius = DoubleInput(0.5)  # "10.Advanced: End Radius"; graph input
n12_tsm_file_path = StringInput("D:\ExportedTspline.tsm")  # "12.TSM File Path"; graph input
n14_family_method_family_name = StringInput("Dynamo T-Spline Form")  # "14.Family Method : Family Name"; graph input
n16_family_method_family_category = Categories("OST_GenericModel")  # "16.Family Method : Family Category"; graph input
n17_family_method_family_template = Filename("..\..\..\..\..\..\..\..\..\..\ProgramData\Autodesk\RVT 2020\Family Templates\English\Metric Generic Model.rft")  # "17.Family Method : Family Template of The Above Category"; graph input
n15_family_method_material = StringInput("")  # "15.Family Method : Material"; graph input
n13_method_false_imported_object = BoolSelector(true)  # "13.Method : False = Imported Object | True = Family"; graph input

code_block = CodeBlock { true; }
ne = n02_fetch_whole_body != code_block
fetch_whole_body = Custom[Fetch Whole Body](VARFetchorNot=n02_fetch_whole_body, VARSurfaces=n01_select_faces)  # package Synthesize toolkit; Fetch Whole Body
surface_importer_2x = Custom[Surface Importer 2x](VAROperate=ne, VARSurfaces=fetch_whole_body)  # package Synthesize toolkit; Surface Importer Updated
flatten = List.Flatten(list=surface_importer_2x)
surface_orientation_filter = Custom[Surface Orientation Filter](VARSurfaces=flatten, VAROrienataion=n03_faces_filter_1_vertical_faces)  # package Synthesize toolkit; Face Filter
prepare_k_paneling_manual_lines = Custom[Prepare K-Paneling Manual Lines UV](VARFaces=surface_orientation_filter.VARSurfaces, VARElements=n04_select_curves_or_divided)  # package Synthesize toolkit; Prepare K-Paneling Manual Lines UV
prepare_k_paneling_divied_paths = Custom[Prepare K-Paneling Divied Paths UV](VARFaces=surface_orientation_filter.VARSurfaces, VARDividedPaths=n04_select_curves_or_divided)  # package Synthesize toolkit; Prepare K-Paneling Divied Paths UV
list_create = List.Create(item0=prepare_k_paneling_manual_lines.VARU, item1=prepare_k_paneling_manual_lines.VARV, item2=prepare_k_paneling_manual_lines.VARW, item3=prepare_k_paneling_divied_paths.VARU, item4=prepare_k_paneling_divied_paths.VARV, item5=prepare_k_paneling_divied_paths.VARW)
code_block_2 = CodeBlock { false; }
clean = List.Clean(list=list_create, preserveIndices=code_block_2)
flatten_2 = List.Flatten(list=clean)
explode = Geometry.Explode(geometry=flatten_2)
flatten_3 = List.Flatten(list=explode)
code_block_3 = CodeBlock { true; }
ne_2 = code_block_3 != n07_method_simple_false_advanced
code_block_4 = CodeBlock { 0; 1; }

# group: In Dynamo Inputs
smooth_mode_in_dynamo = BoolSelector(false)

buildPipes = TSpline.TSplineSurface.BuildPipes(curves=flatten_3, defaultRadius=n08_simple_radius, snappingTolerance=n05_snapping_tolerance, segmentsCount=n06_joints_sharpness, autoHandleStart=ne_2, autoHandleEnd=ne_2, startRotations=code_block_4.out1, endRotations=code_block_4.out0, startRadii=n09_advanced_start_radius, endRadii=n10_advanced_end_radius, startPositions=code_block_4.out1, endPositions=code_block_4.out0, inSmoothMode=smooth_mode_in_dynamo)
empty = List.Empty()
scopeIf = Custom[CW.ScopeIf+](VARtest=n11_export_tsm, VARtrue=buildPipes, VARfalse=empty)  # package Synthesize toolkit; A (hopefully) more robust implementation of ScopeIf. Tests a single boolean and returns a value accordingly.
exportToTSM = TSpline.TSplineSurface.ExportToTSM(tSplineSurface=scopeIf, filePath=n12_tsm_file_path)
empty_2 = List.Empty()
scopeIf_2 = Custom[CW.ScopeIf+](VARtest=smooth_mode_in_dynamo, VARtrue=empty_2, VARfalse=buildPipes)
scopeIf_3 = Custom[CW.ScopeIf+](VARtest=n11_export_tsm, VARtrue=empty_2, VARfalse=scopeIf_2)
toBRep = TSpline.TSplineSurface.ToBRep(tSplineSurface=scopeIf_3)
code_block_5 = CodeBlock { true; }
ne_3 = code_block_5 != n13_method_false_imported_object
k_family_insert = Custom[K-Family Insert](VARGeometryorSAT=toBRep, VARFamilyName=n14_family_method_family_name, VARFamilyCategory=n16_family_method_family_category, VARFamilyTemplatePath=n17_family_method_family_template, VARMaterialName=n15_family_method_material, VARImportInstanceInstead=ne_3)  # package Synthesize toolkit; K-Family Insert
