# Dynamo graph Conceptual.UV Fixer Family.Points Generate From Double Grid.dyn (Dynamo 2.13.1.3887)
# author: karam@aecedx.com
# packages: Synthesize toolkit 12.5.1

# group: Input
n01_select_uv_fixer_double_grid = DSModelElementSelection()  # "01.Select UV Fixer Double Grid Family"; nothing selected; graph input

geometry = Element.Geometry(element=n01_select_uv_fixer_double_grid)
flatten = List.Flatten(list=geometry)
code_block = CodeBlock { "Point"; }
byClassName = Custom[SP.Filter.ByClassName](VARobject=flatten, VARclassName=code_block)  # package Synthesize toolkit; Filters a list of objects by the object's class name. Note that Dynamo elements belong to different classes than their Revit counterparts. Use the Object.Class node to check an object's class.
flatten_2 = List.Flatten(list=byClassName.VARout)
intersectAll = Geometry.IntersectAll(geometry=flatten_2, others=flatten_2@L1)
flatten_3 = List.Flatten(list=intersectAll)
code_block_2 = CodeBlock { "Point"; }
byClassName_2 = Custom[SP.Filter.ByClassName](VARobject=flatten_3, VARclassName=code_block_2)
pruneDuplicates = Point.PruneDuplicates(points=byClassName_2.VARin)
flatten_4 = List.Flatten(list=pruneDuplicates)
byPoint = ReferencePoint.ByPoint(pt=flatten_4)
count = List.Count(list=byPoint)

# group: Report
n01_number_of_generated_points = Watch(count)  # "01.Number of Generated Points"; graph output

note = StringInput("DOES NOT AUTO NAME THE GENERATED POINTS")  # "02.Note"; graph input
debug_python = Custom[Debug Python]()  # package Synthesize toolkit; Debug Python
