# Dynamo graph Conceptual.UV Fixer Family.Points Generate From One Grid.dyn (Dynamo 2.13.1.3887)
# author: karam@aecedx.com
# packages: Synthesize toolkit 12.5.1

# group: Input
n01_select_uv_fixer_one_grid = DSModelElementSelection()  # "01.Select UV Fixer One Grid Family"; nothing selected; graph input
n02_select_start_reference_point = DSModelElementSelection()  # "02.Select Start Reference Point"; nothing selected; graph input
n03_parameter_for_the_number_of = StringInput("Grid Number")  # "03.Parameter For The Number of Points to Generate Per Line"; graph input
n04_number_sequence_start = DoubleInput(1)  # "04.Number Sequence Start"; graph input
note = StringInput("It Auto Names the generated points :)")  # "05.Note"; graph input

geometry = Element.Geometry(element=n01_select_uv_fixer_one_grid)
flatten = List.Flatten(list=geometry)
code_block = CodeBlock { "Point"; }
byClassName = Custom[SP.Filter.ByClassName](VARobject=flatten, VARclassName=code_block)  # package Synthesize toolkit; Filters a list of objects by the object's class name. Note that Dynamo elements belong to different classes than their Revit counterparts. Use the Object.Class node to check an object's class.
flatten_2 = List.Flatten(list=byClassName.VARout)
code_block_2 = CodeBlock { 0.5; }
pointAtParameter = Curve.PointAtParameter(curve=flatten_2, param=code_block_2)
point = ReferencePoint.Point(referencePoint=n02_select_start_reference_point)
sortByDistance = Custom[LF.Points.SortByDistance](VARpoints=pointAtParameter, VARbasePoint=point, VARelements=flatten_2)  # package Synthesize toolkit; Sort a list of points based on their distance from a specified point
code_block_3 = CodeBlock { "Line"; }
byClassName_2 = Custom[SP.Filter.ByClassName](VARobject=sortByDistance, VARclassName=code_block_3)
code_block_4 = CodeBlock { 1; }
getParameterValueByName = Element.GetParameterValueByName(element=n01_select_uv_fixer_one_grid, parameterName=n03_parameter_for_the_number_of)
range = Range(start=code_block_4, end=getParameterValueByName, step=code_block_4, lacing=Longest)
code_block_5 = CodeBlock { 0; 1; }
remapRange = Math.RemapRange(numbers=range, newMin=code_block_5.out0, newMax=code_block_5.out1)
pointAtParameter_2 = Curve.PointAtParameter(curve=byClassName_2.VARin@L1, param=remapRange)
flatten_3 = List.Flatten(list=pointAtParameter_2)
byPoint = ReferencePoint.ByPoint(pt=flatten_3)
code_block_6 = CodeBlock { "Name"; }
code_block_7 = CodeBlock { 0.0001; }
count = List.Count(list=pointAtParameter_2)
code_block_8 = CodeBlock { true; }
alphabeticalSequence = Custom[CW.List.AlphabeticalSequence](VARn=count, VARupperCase=code_block_8)  # package Synthesize toolkit; Creates a list of the first N letters of the alphabet (where 1 = A, 2 = B, ... , 27 = AA, 28 = AB etc.).
code_block_9 = CodeBlock { 1; }
chop = List.Chop(list=alphabeticalSequence, lengths=code_block_9)
count_2 = List.Count(list=pointAtParameter_2@L2)
firstItem = List.FirstItem(list=count_2)
cycle = List.Cycle(list=chop@L2, amount=firstItem)
flatten_4 = List.Flatten(list=cycle)
count_3 = List.Count(list=flatten_4)
sequence = Sequence(start=code_block_7, amount=count_3, step=code_block_7, lacing=Longest)
string_from_object = FromObject(obj=sequence)
setParameterByName = Element.SetParameterByName(element=byPoint, parameterName=code_block_6, value=string_from_object)
passthrough = Custom[CW.Passthrough](VARpassThrough=byPoint, VARwaitFor=setParameterByName)  # package Synthesize toolkit; Forces a sequential order of execution. The node wired into the output of the Passthrough node will be executed *after* the node wired into the waitFor input (e.g. important for some Revit operations). The value of the passThrough input will be passed on to the node wired into the output port of the Passthrough node.
passthrough_2 = Custom[CW.Passthrough](VARpassThrough=code_block_6, VARwaitFor=setParameterByName)
code_block_10 = CodeBlock { ""; }
join = String.Join(separator=code_block_10)  # unwired: string0, string1
code_block_11 = CodeBlock { 1; }
sequence_2 = Sequence(start=n04_number_sequence_start, amount=firstItem, step=code_block_11, lacing=Longest)
string_from_object_2 = FromObject(obj=sequence_2)
ofRepeatedItem = List.OfRepeatedItem(item=string_from_object_2, amount=count)
flatten_5 = List.Flatten(list=ofRepeatedItem)
combine = List.Combine(comb=join, list1=flatten_4, list2=flatten_5)
passthrough_3 = Custom[CW.Passthrough](VARpassThrough=combine, VARwaitFor=setParameterByName)
setParameterByName_2 = Element.SetParameterByName(element=passthrough, parameterName=passthrough_2, value=passthrough_3)
count_4 = List.Count(list=setParameterByName_2)
lastItem = List.LastItem(list=passthrough_3)

# group: Report
n01_number_of_generated_points = Watch(count_4)  # "01.Number of Generated Points"; graph output
n02_last_point_name = Watch(lastItem)  # "02.Last Point Name"; graph output

debug_python = Custom[Debug Python]()  # package Synthesize toolkit; Debug Python
