# Dynamo graph Conceptual.UV Fixer Family.Prepare For Intersects.dyn (Dynamo 2.13.1.3887)
# author: karam@aecedx.com
# packages: Synthesize toolkit 12.5.1

# group: Input
n01_select_uv_fixer = DSModelElementsSelection()  # "01.Select UV Fixer"; nothing selected; graph input
n04_reference_planes_name_prefix = StringInput("UV Fixer Ref Plane")  # "04.Reference Planes Name Prefix"; graph input
n02_flip_reference_planes_side = BoolSelector(false)  # "02.Flip Reference Planes Side"; graph input
n03_reference_planes_offset = DoubleInput(0)  # "03.Reference Planes Offset"; graph input

curves = Element.Curves(element=n01_select_uv_fixer)
n05_number_of_points = DoubleInput(6)  # "05.Number of Points ?"; graph input
sequence = Sequence(amount=n05_number_of_points, lacing=Longest)
code_block = CodeBlock { 0; 1; }
remapRange = Math.RemapRange(numbers=sequence, newMin=code_block.out0, newMax=code_block.out1)
pointAtParameter = Curve.PointAtParameter(curve=curves@L1, param=remapRange)
count = List.Count(list=curves@L2)
chop = List.Chop(list=pointAtParameter, lengths=count)
flatten = List.Flatten(list=chop@L3)
byBestFitThroughPoints = Plane.ByBestFitThroughPoints(points=flatten)
byWidthLength = Rectangle.ByWidthLength(plane=byBestFitThroughPoints)
byPatch = Surface.ByPatch(closedCurve=byWidthLength)
reference_plane_perpendicular_on = Custom[Reference Plane Perpendicular On Face](VARReferencePlaneNamePrefix=n04_reference_planes_name_prefix, VARFlipReferencePlanesSide=n02_flip_reference_planes_side, VARReferencePlanesOffset=n03_reference_planes_offset, VARFaces=byPatch)  # package Synthesize toolkit; Reference Plane Perpendicular On Face
python_script = Python(IN[0]=reference_plane_perpendicular_on)  # IronPython2
# ---------- python_script.python (45 lines) ----------
import clr
clr.AddReference('ProtoGeometry')
from Autodesk.DesignScript.Geometry import *

# Import Element wrapper extension methods
clr.AddReference("RevitNodes")
import Revit
clr.ImportExtensions(Revit.Elements)

# Import geometry conversion extension methods
clr.ImportExtensions(Revit.GeometryConversion)

# Import DocumentManager and TransactionManager
clr.AddReference("RevitServices")
import RevitServices
from RevitServices.Persistence import DocumentManager
from RevitServices.Transactions import TransactionManager

doc = DocumentManager.Instance.CurrentDBDocument
uiapp = DocumentManager.Instance.CurrentUIApplication
app = uiapp.Application

# Import RevitAPI
clr.AddReference("RevitAPI")
import Autodesk
from Autodesk.Revit.DB import *

doc = DocumentManager.Instance.CurrentDBDocument
uiapp = DocumentManager.Instance.CurrentUIApplication
app = uiapp.Application

# The inputs to this node will be stored as a list in the IN variable.
dataEnteringNode = IN

# Unwrap elements and convert geometry from Dynamo to Revit:

rPlanes = UnwrapElement(IN[0])
result = []
# Set the reference plane as the sketchplane in the active view in another transaction
TransactionManager.Instance.EnsureInTransaction(doc)
for each in rPlanes:
	result.append(SketchPlane.Create(doc,each.Id))
TransactionManager.Instance.TransactionTaskDone()

OUT = result
# ----------------------------------------
python_script_2 = Python(IN[0]=chop, IN[1]=python_script)  # IronPython2
# ---------- python_script_2.python (67 lines) ----------
# Enable Python support and load DesignScript library
# IMPORTANT : ALL DYNAMO DESIGN SCRIPT NODES ARE AS (dg)
import clr
clr.AddReference('ProtoGeometry')
from Autodesk.DesignScript import Geometry as dg

# EXTENSION Enable ToDSType
clr.AddReference('RevitNodes')
import Revit
clr.ImportExtensions(Revit.Elements)

# Enable Revit Elements
from Revit.Elements import *

# EXTENSION Enable Geometry Conversion Methods
clr.ImportExtensions(Revit.GeometryConversion)

# Enable Revit API
clr.AddReference('RevitAPI')
from Autodesk.Revit.DB import *

# Enable DocumentManager and TransactionManager
clr.AddReference('RevitServices')
from RevitServices.Persistence import DocumentManager
from RevitServices.Transactions import TransactionManager

# Enable ICollection List Translate
clr.AddReference("System")
import System.Collections.Generic
from System.Collections.Generic import List

doc = DocumentManager.Instance.CurrentDBDocument
app = doc.Application

Pointslist = UnwrapElement(IN[0])
Sketchplanes = UnwrapElement(IN[1])
result = []


TransactionManager.Instance.EnsureInTransaction(doc)

ConvertedSketchPlanes = []
for each in Sketchplanes:
	ConvertedSketchPlanes.append(each.GetPlaneReference())

dynpoints=[]
refpoints=[]

count = 0
for eachplane in ConvertedSketchPlanes:
	tmplist = []
	newcount = 0
	for eachlist in Pointslist[count]:
		anothertmp = []
		for eachpoint in eachlist:
			eachpoint.ToXyz()
			dynpoints = PointOnPlane.NewPointOnPlane(doc,eachplane,eachpoint.ToXyz(),XYZ(0,0,1))
			dynpoints.SetPlaneReference(eachplane)
			refpoints = doc.FamilyCreate.NewReferencePoint(dynpoints)
			anothertmp.append(refpoints)
		tmplist.append(anothertmp)
	result.append(tmplist)
	count = count + 1		

TransactionManager.Instance.TransactionTaskDone()

OUT = result;
# ----------------------------------------
code_block_2 = CodeBlock { true; }
byReferencePoints = CurveByPoints.ByReferencePoints(points=python_script_2, isReferenceLine=code_block_2, lacing=Longest)
debug_python = Custom[Debug Python]()  # package Synthesize toolkit; Debug Python
