# Dynamo graph Conceptual.UV Management Loft Curves With Edges.dyn (Dynamo 2.13.1.3887)
# author: karam@aecedx.com
# packages: Synthesize toolkit 12.5.1

# group: Input
n08_smooth_mode_force_smooth = BoolSelector(false)  # "08.Smooth Mode : Force Smooth Closed Loops - Profiles"; graph input
n09_smooth_mode_points_distancing = DoubleInput(10)  # "09.Smooth Mode : Points Distancing - Profiles"; graph input
n07_smooth_mode_profiles = BoolSelector(false)  # "07.Smooth Mode - Profiles ?"; graph input
n06_loop_mode = BoolSelector(false)  # "06.Loop Mode"; graph input
n05_guides_as_rails = BoolSelector(false)  # "05.Guides As Rails ?"; graph input
n02_profiles_offset_copy = DoubleInput(0)  # "02.Profiles Offset Copy"; graph input
n01_select_curve_profile_s = DSModelElementsSelection()  # "01.Select Curve Profile(s)"; nothing selected; graph input
n11_smooth_mode_force_smooth = BoolSelector(false)  # "11.Smooth Mode : Force Smooth Closed Loops - Guides"; graph input
n12_smooth_mode_points_distancing = DoubleInput(10)  # "12.Smooth Mode : Points Distancing - Guides"; graph input
n10_smooth_mode_guides = BoolSelector(false)  # "10.Smooth Mode - Guides ?"; graph input
n03_select_edge_guide_s = SelectEdges()  # "03.Select Edge Guide(s)"; nothing selected; graph input
n13_import_to_revit = BoolSelector(true)  # "13.Import To Revit ?"; graph input
n25_draw_intersects = BoolSelector(false)  # "25.Draw Intersects ?"; graph input
n26_intersects_u = DoubleInput(10)  # "26.Intersects : U"; graph input
n27_intersects_v = DoubleInput(10)  # "27.Intersects : V"; graph input
n28_intersects_number_of_control = DoubleInput(3)  # "28.Intersects : Number of Control Points Per Intersecting Line"; graph input
n29_intersects_extend_distance = DoubleInput(1)  # "29.Intersects : Extend Distance"; graph input
n31_intersects_reference_planes = DoubleInput(5)  # "31.Intersects : Reference Planes Offset From Face"; graph input
n30_intersects_reference_planes = StringInput("Dynamo Reference Planes")  # "30.Intersects : Reference Planes Name Pre-Fix"; graph input
n32_intersects_flip_reference = BoolSelector(false)  # "32.Intersects : Flip Reference Planes Side ?"; graph input
n18_family_method_family_name = StringInput("Dynamo Loft Family")  # "18.Family Method : Family Name"; graph input
n20_family_method_start_sequence = DoubleInput(1)  # "20.Family Method : Start Sequence (Naming Suffix) - Manual Mode"; graph input
n22_family_method_category = Categories("OST_Mass")  # "22.Family Method : Category"; graph input
n14_method_false_imported_object = BoolSelector(true)  # "14.Method : False = Imported Object | True = Family"; graph input
n24_family_method_family_template = Filename("..\..\..\..\..\..\..\..\..\..\ProgramData\Autodesk\RVT 2020\Family Templates\English\Conceptual Mass\Metric Mass.rft")  # "24.Family Method : Family Template of The Above Category"; graph input
n17_family_method_to_void = BoolSelector(false)  # "17.Family Method : To Void ?"; graph input
n15_family_method_1_family_only = BoolSelector(false)  # "15.Family Method : 1 Family Only ? (False = Family For Each Solid/Surface)"; graph input
n16_family_method_is_shared = BoolSelector(false)  # "16.Family Method : Is Shared Family ?"; graph input
n33_export_to_sat = BoolSelector(false)  # "33.Export To SAT ?"; graph input
n34_sat_export_path = StringInput("D:\Exported Loft.sat")  # "34.SAT Export Path"; graph input
n04_guides_offset = DoubleInput(0)  # "04.Guides Offset"; graph input
n21_family_method_material = StringInput("")  # "21.Family Method : Material"; graph input
n23_family_method_subcategory = StringInput("")  # "23.Family Method : Subcategory"; graph input
n19_family_method_sequence_naming = BoolSelector(true)  # "19.Family Method : Sequence Naming Mode : True = Auto | False = Manual"; graph input

geometry_of_model_curves_and = Custom[Geometry of Model Curves and Curve By Points](VARElements=n01_select_curve_profile_s)  # package Synthesize toolkit; Geometry and Vector of Model Curves and Curve By Points
smart_rft_path = Custom[Smart RFT Path](VARRFTFile=n24_family_method_family_template, VARCategory=n22_family_method_category)  # package Synthesize toolkit; Smart RFT Path
family_method_place_instance = BoolSelector(false)  # "Family Method : Place Instance Even If Already Placed ?"
family_method_positioning_system = BoolSelector(true)  # "Family Method : Positioning System : False = Instance Origin | True = Relative To Project Origin"
family_method_update_family_even = BoolSelector(true)  # "Family Method : Update Family Even If Already Exists ?"
uv_management_loft = Custom[UV Management Loft](VARForceCloseProfiles=n08_smooth_mode_force_smooth, VARPointsDistanceProfiles=n09_smooth_mode_points_distancing, VARSmoothModeProfiles=n07_smooth_mode_profiles, VARLoopMode=n06_loop_mode, VARGuidesasRails=n05_guides_as_rails, VAROffsetProfiles=n02_profiles_offset_copy, VARProfiles=geometry_of_model_curves_and, VARForceCloseGuides=n11_smooth_mode_force_smooth, VARPointsDistanceGuides=n12_smooth_mode_points_distancing, VARSmoothModeGuides=n10_smooth_mode_guides, VARGuides=n03_select_edge_guide_s, VARImportToRevit=n13_import_to_revit, VARDrawIntersects=n25_draw_intersects, VARU=n26_intersects_u, VARV=n27_intersects_v, VARNumberofControlPointsPerLine=n28_intersects_number_of_control, VARExtraExtendedDistance=n29_intersects_extend_distance, VARReferencePlanesOffset=n31_intersects_reference_planes, VARReferencePlaneNamePrefix=n30_intersects_reference_planes, VARFlipReferencePlanesSide=n32_intersects_flip_reference, VARFamilyName=n18_family_method_family_name, VARStartSequenceNamingSuffix=n20_family_method_start_sequence, VARFamilyCategory=n22_family_method_category, VARMethodFalseIsImportedObjectTrueIsFamily=n14_method_false_imported_object, VARFamilyTemplate=smart_rft_path, VARIsVoid=n17_family_method_to_void, VAROneFamily=n15_family_method_1_family_only, VARisShared=n16_family_method_is_shared, VARExportSAT=n33_export_to_sat, VARSATFilepath=n34_sat_export_path, VAROffsetGuides=n04_guides_offset, VARPlaceInstaceEvenIfAlreadyPlaced=family_method_place_instance, VARPositionSystemFalseIsInstanceOriginTrueIsRelativeToProjectOrigin=family_method_positioning_system, VARmaterialName=n21_family_method_material, VARsubcategoryName=n23_family_method_subcategory, VARUpdateFamilyEvenIfAlreadyExists=family_method_update_family_even, VARAutoSequenceNamingSuffix=n19_family_method_sequence_naming)  # package Synthesize toolkit; UV Management Loft

# group: Report
n01_revit_import_report = Watch(uv_management_loft.VARRevitImportReport)  # "01.Revit Import Report"; graph output

uv_management_intersects = Custom[UV Management Intersects Function](VARElements=uv_management_loft.VARToIntesectElements, VARIntersects=uv_management_loft.VARToIntesectLines, VARDrawIntersectsToggle=n25_draw_intersects)  # package Synthesize toolkit; UV Management Intersects Function
debug_python = Custom[Debug Python]()  # package Synthesize toolkit; Debug Python
