# Dynamo graph Coordination.Place Coordination Family By Family and Type.dyn (Dynamo 2.13.1.3887)
# author: karam@aecedx.com
# packages: Synthesize toolkit 12.5.1

# group: Input
n02_all_elements_of_family_name = BoolSelector(true)  # "02.All Elements of Family Name (All types) ?"; graph input
n01_family_names_separate_by = StringInput("Family")  # "01.Family Names (Separate By Comma , - or * To Select All Matching)"; graph input
n03_specific_type_names_separate = StringInput("Type")  # "03.Specific Type Names (Separate by Comma , )"; graph input
n04_elements_in_active_view_only = BoolSelector(false)  # "04.Elements In Active View Only ?"; graph input
n06_coordination_family_to_place = FamilyTypes("Sample K-Coordinator:Sample K-Coordinator")  # "06.Coordination Family To Place"; graph input
n09_family_info_parameter = StringInput("Family Info")  # "09.Family Info Parameter"; graph input
n05_delete_unused_coordination = BoolSelector(true)  # "05.Delete Unused Coordination Families"; graph input
n07_internal_origin_1_project = IntegerSlider(1, range=1..3 step 1)  # "07.Internal Origin = 1 | Project Base Point = 2 | Survey Point = 3"; graph input
rounding = DoubleInput(0.001)  # "13.Rounding"; graph input
n15_time_parameter = StringInput("Time Updated")  # "15.Time Parameter"; graph input
n14_point_reference_parameter = StringInput("Point Reference")  # "14.Point Reference Parameter (Internal | Base Point | Survey)"; graph input
n12_z_point_parameter = StringInput("Z")  # "12.Z Point Parameter"; graph input
n11_y_point_parameter = StringInput("Y")  # "11.Y Point Parameter"; graph input
n10_x_point_parameter = StringInput("X")  # "10.X Point Parameter"; graph input
n08_document_parameter = StringInput("Document")  # "08.Document Parameter"; graph input

code_block = CodeBlock { ","; }
family_and_type_selector = Custom[Family and Type Selector](VARAllElementsofFamilyNameAlltypes=n02_all_elements_of_family_name, VARFamilyName=n01_family_names_separate_by, VARSpecificTypeNamesSeparatebySymbol=n03_specific_type_names_separate, VARSeparationSymbol=code_block, VAROnlyInActiveView=n04_elements_in_active_view_only)  # package Synthesize toolkit; Family and Type Selector
flatten = List.Flatten(list=family_and_type_selector.VARElements)
coordination_family_management = Custom[Coordination Family Management](VARElementsToPlaceCoordination=flatten, VARFamilyType=n06_coordination_family_to_place, VARFamilyInfoParameterName=n09_family_info_parameter, VARDeleteUnusedCoordinationFamily=n05_delete_unused_coordination, VARInternalOriginIs1ProjectBasePointIs2SurveyPointIs3=n07_internal_origin_1_project, VARprecision=rounding, VARTimeParameter=n15_time_parameter, VARPointReferenceParameter=n14_point_reference_parameter, VARYParameter=n12_z_point_parameter, VARZParameter=n11_y_point_parameter, VARXParameter=n10_x_point_parameter, VARDocumentParameter=n08_document_parameter)  # package Synthesize toolkit; Coordination Management
debug_python = Custom[Debug Python]()  # package Synthesize toolkit; Debug Python
