# Dynamo graph Cut.Bruteforce By Selection Filter.dyn (Dynamo 2.13.1.3887)
# author: karam@aecedx.com
# packages: Synthesize toolkit 12.5.1

# group: Input
n02_solid_with_solid_fasle_solid = BoolSelector(false)  # "02.Solid with Solid = Fasle | Solid with Void = True"; graph input
n01_selection_filter_to_read_and = StringInput("Selection Filter")  # "01.Selection Filter to Read and Cut"; graph input

hot_get_all_filter = Custom[HOT.Get All Filter]()  # package Synthesize toolkit; Get all Filter
toLower = String.ToLower(string=hot_get_all_filter.VARName)
trimWhitespace = String.TrimWhitespace(string=toLower)
toLower_2 = String.ToLower(string=n01_selection_filter_to_read_and)
trimWhitespace_2 = String.TrimWhitespace(string=toLower_2)
eq = trimWhitespace == trimWhitespace_2
filterByBoolMask = List.FilterByBoolMask(list=hot_get_all_filter.VARElement, mask=eq)
elements = Custom[CW.SelectionSet.Elements](VARselectionSet=filterByBoolMask.in)  # package Synthesize toolkit; Retrieves all elements stored in a selection set
flatten = List.Flatten(list=elements)
code_block = CodeBlock { null; }
scopeIf = Custom[CW.ScopeIf+](VARtest=n02_solid_with_solid_fasle_solid, VARtrue=flatten, VARfalse=code_block)  # package Synthesize toolkit; A (hopefully) more robust implementation of ScopeIf. Tests a single boolean and returns a value accordingly.
cutGeometry = Custom[HOT.CutGeometry](VARElementList=scopeIf)  # package Synthesize toolkit
scopeIf_2 = Custom[CW.ScopeIf+](VARtest=n02_solid_with_solid_fasle_solid, VARtrue=code_block, VARfalse=flatten)
hot_cutgeometry_solid_with_solid = Custom[HOT.CutGeometry Solid with Solid](VARElementList=scopeIf_2)  # package Synthesize toolkit
debug_python = Custom[Debug Python]()  # package Synthesize toolkit; Debug Python
