# Dynamo graph Cut.Bruteforce By Selection.dyn (Dynamo 2.13.1.3887)
# author: karam@aecedx.com
# packages: Synthesize toolkit 12.5.1

# group: Input
n02_solid_with_solid_fasle_solid = BoolSelector(false)  # "02.Solid with Solid = Fasle | Solid with Void = True"; graph input
n01_select_elements_to_cut = DSModelElementsSelection()  # "01.Select Elements to Cut"; nothing selected; graph input

flatten = List.Flatten(list=n01_select_elements_to_cut)
code_block = CodeBlock { null; }
scopeIf = Custom[CW.ScopeIf+](VARtest=n02_solid_with_solid_fasle_solid, VARtrue=flatten, VARfalse=code_block)  # package Synthesize toolkit; A (hopefully) more robust implementation of ScopeIf. Tests a single boolean and returns a value accordingly.
cutGeometry = Custom[HOT.CutGeometry](VARElementList=scopeIf)  # package Synthesize toolkit
scopeIf_2 = Custom[CW.ScopeIf+](VARtest=n02_solid_with_solid_fasle_solid, VARtrue=code_block, VARfalse=flatten)
hot_cutgeometry_solid_with_solid = Custom[HOT.CutGeometry Solid with Solid](VARElementList=scopeIf_2)  # package Synthesize toolkit
debug_python = Custom[Debug Python]()  # package Synthesize toolkit; Debug Python
