# Dynamo graph Debug.Find Faulty Nodes.dyn (Dynamo 2.13.1.3887)
# author: karam@aecedx.com
# packages: Synthesize toolkit 12.5.1

# group: Input
n01_directory_path = Directory("C:\Users\karam\AppData\Roaming\Dynamo\Dynamo Revit\1.3\packages\Synthesize toolkit\extra")  # "01.Directory Path"; graph input
n02_node_to_search_for = StringInput("Faulty Node")  # "02.Node to Search for"; graph input

contentsAll = Custom[CW.Directory.ContentsAll](VARdirectoryPath=n01_directory_path)  # package Synthesize toolkit; Unlike the built-in node Directory.Contents, this node browses a directory recursively and returns all relevant files contained in subfolders as well.
readText = FileSystem.ReadText(file=contentsAll)
code_block = CodeBlock { false; }
countOccurrences = String.CountOccurrences(string=readText, searchFor=n02_node_to_search_for, ignoreCase=code_block)
code_block_2 = CodeBlock { 0; }
gt = countOccurrences > code_block_2
filterByBoolMask = List.FilterByBoolMask(list=contentsAll, mask=gt)

# group: Result
files = Watch(filterByBoolMask.in)  # "01.Files"; graph output
watch = Custom[SP.Watch+](VARinput=files)  # package Synthesize toolkit; This node that serializes the input information and presents it in a resizable text window.

debug_python_no_message = Custom[Debug Python No Message]()  # package Synthesize toolkit; Debug Python
