# Dynamo graph Detail.Separate Filled Regions.dyn (Dynamo 2.13.1.3887)
# author: karam@aecedx.com
# packages: Synthesize toolkit 12.5.1

# group: Input
n01_select_filled_masking_regions = DSModelElementsSelection()  # "01.Select Filled/Masking Regions"; nothing selected; graph input
code_block = CodeBlock { "FilledRegion"; }

byClassName = Custom[SP.Filter.ByClassName](VARobject=n01_select_filled_masking_regions, VARclassName=code_block)  # package Synthesize toolkit; Filters a list of objects by the object's class name. Note that Dynamo elements belong to different classes than their Revit counterparts. Use the Object.Class node to check an object's class.
current = Document.Current()
activeView = Document.ActiveView(document=current)
element_geometry_fixer_legacy = Custom[Element.Geometry Fixer Legacy](VARElements=byClassName.VARin)  # package Synthesize toolkit; Element.Geometry Fixer Legacy
code_block_2 = CodeBlock { "Surface"; }
byClassName_2 = Custom[SP.Filter.ByClassName](VARobject=element_geometry_fixer_legacy, VARclassName=code_block_2)
perimeterCurves = Surface.PerimeterCurves(surface=byClassName_2.VARin)
as_polycurve_bycurves = Custom[AS.[&] PolyCurve.ByCurves](VARcurves=perimeterCurves)  # package Synthesize toolkit; Create polycurves from an unordered list of curves.
flatten = List.Flatten(list=as_polycurve_bycurves.VARpolyCurve@L3)
curves = PolyCurve.Curves(polyCurve=flatten)
code_block_3 = CodeBlock { "Type"; }
getParameterValueByName = Element.GetParameterValueByName(element=byClassName.VARin, parameterName=code_block_3)
byCurves = FilledRegion.ByCurves(view=activeView, boundary=curves, regionType=getParameterValueByName)
parameters = Element.Parameters(element=byClassName.VARin)
name = Parameter.Name(parameter=parameters)
value = Parameter.Value(parameter=parameters)
python_script = Python(IN[0]=byCurves, IN[1]=name, IN[2]=value)  # IronPython2
# ---------- python_script.python (64 lines) ----------
# Enable Python support and load DesignScript library
# IMPORTANT : ALL DYNAMO DESIGN SCRIPT NODES ARE AS (dg)
import clr
clr.AddReference('ProtoGeometry')
from Autodesk.DesignScript import Geometry as dg

# EXTENSION Enable ToDSType
clr.AddReference('RevitNodes')
import Revit
clr.ImportExtensions(Revit.Elements)

# Enable Revit Elements
from Revit.Elements import *

# EXTENSION Enable Geometry Conversion Methods
clr.ImportExtensions(Revit.GeometryConversion)

# Enable Revit API
clr.AddReference('RevitAPI')
from Autodesk.Revit.DB import *

# Enable DocumentManager and TransactionManager
clr.AddReference('RevitServices')
from RevitServices.Persistence import DocumentManager
from RevitServices.Transactions import TransactionManager

# Enable ICollection List Translate
clr.AddReference("System")
import System.Collections.Generic
from System.Collections.Generic import List

dataEnteringNode = IN
# Use UnwrapElement(IN[0]) When Translating From Dynamo to Revit
regiongroups=(IN[0])
names=UnwrapElement(IN[1])
values=UnwrapElement(IN[2])

# Choose The Current Document
doc = DocumentManager.Instance.CurrentDBDocument
uidoc = DocumentManager.Instance.CurrentUIApplication.ActiveUIDocument
uiapp = DocumentManager.Instance.CurrentUIApplication
app = uiapp.Application

# Create Empty List
result = []

bigcounter = 0
for g in regiongroups:
	currentgroup = g
	currentnames = names[bigcounter]
	currentvalues = values[bigcounter]
	bigcounter += 1
	for f in currentgroup:
		currentfilled = f
		minicounter = 0
		for N in currentnames:
			currentV = currentvalues[minicounter]
			minicounter += 1
			try:
				Revit.Elements.Element.SetParameterByName(f,N, currentV)
			except: pass

# Assign your output to the OUT variable.
OUT = result
# ----------------------------------------
passthrough = Custom[CW.Passthrough](VARpassThrough=byClassName.VARin, VARwaitFor=python_script)  # package Synthesize toolkit; Forces a sequential order of execution. The node wired into the output of the Passthrough node will be executed *after* the node wired into the waitFor input (e.g. important for some Revit operations). The value of the passThrough input will be passed on to the node wired into the output port of the Passthrough node.
eraser = Custom[ST.Tool.Eraser](VARList=passthrough)  # package Synthesize toolkit; Try to delete any element from project
debug_python = Custom[Debug Python]()  # package Synthesize toolkit; Debug Python
