# Dynamo graph Dimensions.Move Text to Middle By Selection.dyn (Dynamo 2.13.1.3887)
# author: karam@aecedx.com
# packages: Synthesize toolkit 12.5.1

# group: Input
n01_select_dimensions = DSModelElementsSelection()  # "01.Select Dimensions"; nothing selected; graph input
n02_y_justification_based_on = DoubleSlider(0, range=-100..100 step 0.001)  # "02.Y Justification (Based On Sheet Size)"; graph input
n03_x_justification_based_on = DoubleSlider(0, range=-100..100 step 0.001)  # "03.X Justification (Based On Sheet Size)"; graph input
n04_leader_visibility = BoolSelector(false)  # "04.Leader Visibility ?"; graph input

move_dimension_text_to_middle = Custom[Move Dimension Text to Middle](VARElements=n01_select_dimensions, VARYJustification=n02_y_justification_based_on, VARXJustification=n03_x_justification_based_on, VARLeaderVisibility=n04_leader_visibility)  # package Synthesize toolkit; Move Dimension Text to Middle
debug_python = Custom[Debug Python]()  # package Synthesize toolkit; Debug Python
