# Dynamo graph Dimensions.Value Override.dyn (Dynamo 2.13.1.3887)
# author: karam@aecedx.com
# packages: Synthesize toolkit 12.5.1

rh_pick_model_elements = Custom[RH.Pick Model Elements]()  # package Synthesize toolkit; This node offers a pick method for selecting elements in Revit.
code_block = CodeBlock { "Dimension"; }
byClassName = Custom[SP.Filter.ByClassName](VARobject=rh_pick_model_elements, VARclassName=code_block)  # package Synthesize toolkit; Filters a list of objects by the object's class name. Note that Dynamo elements belong to different classes than their Revit counterparts. Use the Object.Class node to check an object's class.
n01_value_to_override_with = StringInput("5")  # "01.Value to Override with"; graph input
setValueOverride = Dimension.SetValueOverride(dimension=byClassName.VARin, values=n01_value_to_override_with)
debug_python_no_message = Custom[Debug Python No Message]()  # package Synthesize toolkit; Debug Python
