# Dynamo graph Document.Categories Lineweights Increment.dyn (Dynamo 2.13.1.3887)
# author: karam@aecedx.com
# packages: Synthesize toolkit 12.5.1

# group: Input
n01_change_subcategories_as_well = BoolSelector(true)  # "01.Change Subcategories As Well ?"; graph input
n02_change_linestyles_as_well = BoolSelector(true)  # "02.Change Linestyles As Well ?"; graph input
n03_projection_lineweights_to = DoubleInput(1)  # "03.Projection Lineweights To Increment"; graph input
n04_cut_lineweight_to_increment = DoubleInput(1)  # "04.Cut Lineweight To Increment"; graph input

python_script = Python(IN[0]=n01_change_subcategories_as_well, IN[1]=n02_change_linestyles_as_well, IN[2]=n03_projection_lineweights_to, IN[3]=n04_cut_lineweight_to_increment)  # IronPython2
# ---------- python_script.python (62 lines) ----------
# Created By Karam Baki: karam@aecedx.com

import clr
clr.AddReference('RevitNodes')
import Revit
clr.AddReference('RevitAPI')
from Autodesk.Revit.DB import *
clr.AddReference('RevitServices')
from RevitServices.Persistence import DocumentManager
from RevitServices.Transactions import TransactionManager

def changeOP(cat,withsubcats,extraweight,iscut=False):
	try:
		if iscut:
			projorcut = GraphicsStyleType.Cut
		else:
			projorcut = GraphicsStyleType.Projection
		oldweight = cat.GetLineWeight(projorcut)
		if oldweight != None and oldweight != -1:
			new_weight = oldweight + extraweight
			if new_weight > 0 and new_weight < 17:
				cat.SetLineWeight(new_weight,projorcut)
			elif new_weight > 15:
				cat.SetLineWeight(16,projorcut)
			elif new_weight < 1:
				cat.SetLineWeight(1,projorcut)
		if withsubcats:
			subcats = cat.SubCategories
			for subcat in subcats:
				oldsubweight = subcat.GetLineWeight(projorcut)
				if oldsubweight != None and oldsubweight != -1:
					new_subweight = oldsubweight + extraweight
					if new_subweight > 0 and new_subweight < 17:
						subcat.SetLineWeight(new_subweight,projorcut)
					elif new_subweight > 15:
						subcat.SetLineWeight(16,projorcut)
					elif new_subweight < 1:
						subcat.SetLineWeight(1,projorcut)
		return "Success"
	except:
		return "Fail"

withsubcats = IN[0]
withlinestyles = IN[1]
projval = IN[2]
cutval = IN[3]

doc = DocumentManager.Instance.CurrentDBDocument
status = []
TransactionManager.Instance.EnsureInTransaction(doc)
allcats = doc.Settings.Categories
for cat in allcats:
	if withlinestyles == False:
		if cat.Name == "Lines":
			break
	if projval != 0:
		status.append(changeOP(cat,withsubcats,projval))
	if cutval != 0:
		status.append(changeOP(cat,withsubcats,projval,True))
TransactionManager.Instance.TransactionTaskDone()

OUT = status
# ----------------------------------------
debug_python_no_message = Custom[Debug Python No Message]()  # package Synthesize toolkit; Debug Python
