# Dynamo graph Editor.Auto Associate Elements Parameters.dyn (Dynamo 2.13.1.3887)
# author: karam@aecedx.com
# packages: Synthesize toolkit 12.5.1

# group: Input
n03_auto_group_by_volumes = BoolSelector(true)  # "03.Auto Group By Volumes ?"; graph input
n01_select_elements = DSModelElementsSelection()  # "01.Select Elements"; nothing selected; graph input
n04_auto_group_rounding = DoubleInput(10)  # "04.Auto Group: Rounding"; graph input
n02_parameter_to_associate = StringInput("Extrusion End")  # "02.Parameter to Associate"; graph input
n06_new_parameters_prefix = StringInput("")  # "06.New Parameters Prefix"; graph input
n05_new_parameters_as_instance = BoolSelector(false)  # "05.New Parameters As Instance ?"; graph input
n08_sort_parameters = BoolSelector(true)  # "08.Sort Parameters ?"; graph input
n07_new_parameters_group_pg = BuiltInParameterGroup("PG_GEOMETRY")  # "07.New Parameters Group (PG_Geometry is Dimensions)"; graph input
n09_avoid_conflicts = BoolSelector(false)  # "09.Avoid Conflicts ?"; graph input

empty = List.Empty()
scopeIf = Custom[CW.ScopeIf+](VARtest=n03_auto_group_by_volumes, VARtrue=n01_select_elements, VARfalse=empty)  # package Synthesize toolkit; A (hopefully) more robust implementation of ScopeIf. Tests a single boolean and returns a value accordingly.
group_family_editor_elements_by = Custom[Group Family Editor Elements By Volumes](VARElements=scopeIf, VARRounding=n04_auto_group_rounding)  # package Synthesize toolkit; Group Family Editor Elements By Volumes
scopeIf_2 = Custom[CW.ScopeIf+](VARtest=n03_auto_group_by_volumes, VARtrue=group_family_editor_elements_by, VARfalse=n01_select_elements)
auto_element_parameters = Custom[Auto Element Parameters Associate](VARElements=scopeIf_2, VARParametertoAssociate=n02_parameter_to_associate, VARNewParametersPrefix=n06_new_parameters_prefix, VARNewParameterAsInstance=n05_new_parameters_as_instance, VARSortParameters=n08_sort_parameters, VARBuiltInParameterGroupString=n07_new_parameters_group_pg, VARAvoidConflicts=n09_avoid_conflicts)  # package Synthesize toolkit; Auto Element Parameters Associate
