# Dynamo graph Editor.Auto Associate Nested Family Parameters.dyn (Dynamo 2.13.1.3887)
# author: karam@aecedx.com
# packages: Synthesize toolkit 12.5.1

# group: Input
n01_select_family = DSModelElementSelection()  # "01.Select Family"; nothing selected; graph input
n03_all_parameters_false_to = BoolSelector(true)  # "03.All Parameters (False to Filter By Parameter Group)"; graph input
n02_new_parameters_prefix = StringInput("")  # "02.New Parameters Prefix"; graph input
n04_select_parameter_group_pg = BuiltInParameterGroup("PG_GEOMETRY")  # "04.Select Parameter Group (PG_Geometry is Dimensions)"; graph input

auto_family_parameters_associate = Custom[Auto Family Parameters Associate](VARFamilyInstance=n01_select_family, VAREverything=n03_all_parameters_false_to, VARNewParametersPrefix=n02_new_parameters_prefix, VARBuiltInParameterGroup=n04_select_parameter_group_pg)  # package Synthesize toolkit; Auto Family Parameters Associate
debug_python_no_message = Custom[Debug Python No Message]()  # package Synthesize toolkit; Debug Python
