# Dynamo graph Editor.Auto Associate Nested Family Types and Parameters.dyn (Dynamo 2.13.1.3887)
# author: karam@aecedx.com
# packages: Synthesize toolkit 12.5.1

debug_python_no_message = Custom[Debug Python No Message]()  # package Synthesize toolkit; Debug Python

# group: Input
n01_select_family = DSModelElementSelection()  # "01.Select Family"; nothing selected; graph input

auto_family_parameters_associate = Custom[Auto Family Parameters Associate With Types](VARFamilyInstance=n01_select_family)  # package Synthesize toolkit; Auto Family Parameters Associate With Types
