# Dynamo graph Editor.Extrusion By Base Surfaces.dyn (Dynamo 2.13.1.3887)
# author: karam@aecedx.com
# packages: Synthesize toolkit 12.5.1

# group: Input
n04_delete_old_surfaces = BoolSelector(true)  # "04.Delete Old Surfaces ?"; graph input
n01_select_surfaces_extrusions = DSModelElementsSelection()  # "01.Select Surfaces/Extrusions"; nothing selected; graph input
n06_scale_new_x = DoubleInput(1)  # "06.Scale: New X"; graph input
n05_scale_old_x = DoubleInput(1)  # "05.Scale: Old X"; graph input
n08_scale_new_y = DoubleInput(1)  # "08.Scale: New Y"; graph input
n07_scale_old_y = DoubleInput(1)  # "07.Scale: Old Y"; graph input
thickness = DoubleInput(1)  # "02.Thickness"; graph input
n03_single_extrusion = BoolSelector(false)  # "03.Single Extrusion ?"; graph input

code_block = CodeBlock { "Extrusion"; }
filterByString = Custom[ST.List.FilterByString](VARlist=n01_select_surfaces_extrusions, VARString=code_block)  # package Synthesize toolkit; Filter a list by a string match
empty = List.Empty()
scopeIf = Custom[CW.ScopeIf+](VARtest=n04_delete_old_surfaces, VARtrue=filterByString.VAROther, VARfalse=empty)  # package Synthesize toolkit; A (hopefully) more robust implementation of ScopeIf. Tests a single boolean and returns a value accordingly.
div = n06_scale_new_x / n05_scale_old_x
div_2 = n08_scale_new_y / n07_scale_old_y
python_script = Python(IN[0]=div, IN[1]=div_2, IN[2]=filterByString.VAROther)  # IronPython2
# ---------- python_script.python (8 lines) ----------
import clr
clr.AddReference('ProtoGeometry')
from Autodesk.DesignScript.Geometry import *
#The inputs to this node will be stored as a list in the IN variables.
dataEnteringNode = IN

#Assign your output to the OUT variable.
OUT = IN[0] == 1 and IN[1] == 1 and IN[2] == []
# ----------------------------------------
empty_2 = List.Empty()
scopeIf_2 = Custom[CW.ScopeIf+](VARtest=python_script, VARtrue=empty_2, VARfalse=filterByString.VAROther)
element_geometry_fast = Custom[Element.Geometry Fast](VARElements=scopeIf_2)  # package Synthesize toolkit; Element.Geometry Fast
flatten = List.Flatten(list=element_geometry_fast)
smart_geometry_scale = Custom[Smart Geometry Scale](VARGeometry=flatten, VARXAmount=div, VARYAmount=div_2, VARZAmount=div)  # package Synthesize toolkit; Smart Geometry Scale
dynamo_geometry_to_revit = Custom[Dynamo Geometry To Revit Compatibility](VARGeometryOrSat=smart_geometry_scale)  # package Synthesize toolkit; Dynamo Geometry To Revit Compatibility
python_null_2_empty = Custom[Python Null 2 Empty](VARIN=dynamo_geometry_to_revit)  # package Synthesize toolkit; Python Null 2 Empty
flatten_2 = List.Flatten(list=python_null_2_empty)
scopeIf_3 = Custom[CW.ScopeIf+](VARtest=python_script, VARtrue=filterByString.VAROther, VARfalse=flatten_2)
code_block_2 = CodeBlock { true; }
ne = python_script != code_block_2
python_script_2 = Python(IN[0]=scopeIf_3, IN[1]=thickness, IN[2]=n04_delete_old_surfaces, IN[3]=ne, IN[4]=n03_single_extrusion)  # IronPython2
# ---------- python_script_2.python (95 lines) ----------
# Enable Python support and load DesignScript library
# IMPORTANT : ALL DYNAMO DESIGN SCRIPT NODES ARE AS (dg)
import clr
clr.AddReference('ProtoGeometry')
from Autodesk.DesignScript import Geometry as dg

# EXTENSION Enable ToDSType
clr.AddReference('RevitNodes')
import Revit
clr.ImportExtensions(Revit.Elements)

# Enable Revit Elements
from Revit.Elements import *

# EXTENSION Enable Geometry Conversion Methods
clr.ImportExtensions(Revit.GeometryConversion)

# Enable Revit API
clr.AddReference('RevitAPI')
from Autodesk.Revit.DB import *

# Enable DocumentManager and TransactionManager
clr.AddReference('RevitServices')
from RevitServices.Persistence import DocumentManager
from RevitServices.Transactions import TransactionManager

# Enable ICollection List Translate
clr.AddReference("System")
import System.Collections.Generic
from System.Collections.Generic import List

def tolist(obj1):
	if hasattr(obj1,'__iter__'): return obj1
	else: return [obj1]

doc = DocumentManager.Instance.CurrentDBDocument

if IN[0] == None:
	OUT = []
elif len(IN[0]) == 0:
	OUT = []
else:
	forms = UnwrapElement(tolist(IN[0]))
	if int(DocumentManager.Instance.CurrentUIApplication.Application.VersionNumber) < 2021:
		thickness = UnitUtils.ConvertToInternalUnits(IN[1],doc.GetUnits().GetFormatOptions(UnitType.UT_Length).DisplayUnits)
	else:
		thickness = UnitUtils.ConvertToInternalUnits(IN[1],doc.GetUnits().GetFormatOptions(SpecTypeId.Length).GetUnitTypeId())
	delete = IN[2]
	forcedelete = IN[3]
	single = IN[4]
	
	result  = []
	
	TransactionManager.Instance.EnsureInTransaction(doc)
	opt1 = Options()
	
	if single:
		curveArrArray = CurveArrArray()
		for f in forms:
			try:
				curveloops = list(list(f.get_Geometry(opt1))[0].Faces)[0].GetEdgesAsCurveLoops()
				for loop in curveloops:
					curveArray1 = CurveArray()
					for c in loop:
						curveArray1.Append(c)
					curveArrArray.Append(curveArray1)
				if delete or forcedelete:
					doc.Delete(f.Id)
			except:
				result.append(None)
		firstlevel = FilteredElementCollector(doc).OfCategory(BuiltInCategory.OST_Levels).WhereElementIsNotElementType().FirstElementId()
		activesketch = SketchPlane.Create(doc,firstlevel)
		solid1 = doc.FamilyCreate.NewExtrusion(True, curveArrArray, activesketch, thickness)
		result.append(solid1)
	else:
		for f in forms:
			try:
				curveArrArray = CurveArrArray()
				curveloops = list(list(f.get_Geometry(opt1))[0].Faces)[0].GetEdgesAsCurveLoops()
				for loop in curveloops:
					curveArray1 = CurveArray()
					for c in loop:
						curveArray1.Append(c)
					curveArrArray.Append(curveArray1)
				firstlevel = FilteredElementCollector(doc).OfCategory(BuiltInCategory.OST_Levels).WhereElementIsNotElementType().FirstElementId()
				activesketch = SketchPlane.Create(doc,firstlevel)
				solid1 = doc.FamilyCreate.NewExtrusion(True, curveArrArray, activesketch, thickness)
				result.append(solid1)
				if delete or forcedelete:
					doc.Delete(f.Id)
			except:
				result.append(None)
	TransactionManager.Instance.TransactionTaskDone()
	
	OUT = result
# ----------------------------------------
passthrough = Custom[CW.Passthrough](VARpassThrough=scopeIf, VARwaitFor=python_script_2)  # package Synthesize toolkit; Forces a sequential order of execution. The node wired into the output of the Passthrough node will be executed *after* the node wired into the waitFor input (e.g. important for some Revit operations). The value of the passThrough input will be passed on to the node wired into the output port of the Passthrough node.
eraser = Custom[ST.Tool.Eraser](VARList=passthrough)  # package Synthesize toolkit; Try to delete any element from project
debug_python_no_message = Custom[Debug Python No Message]()  # package Synthesize toolkit; Debug Python
python_script_3 = Python(IN[0]=filterByString.VARMatch, IN[1]=thickness, IN[2]=n04_delete_old_surfaces, IN[3]=n03_single_extrusion)  # IronPython2
# ---------- python_script_3.python (89 lines) ----------
# Enable Python support and load DesignScript library
# IMPORTANT : ALL DYNAMO DESIGN SCRIPT NODES ARE AS (dg)
import clr
clr.AddReference('ProtoGeometry')
from Autodesk.DesignScript import Geometry as dg

# EXTENSION Enable ToDSType
clr.AddReference('RevitNodes')
import Revit
clr.ImportExtensions(Revit.Elements)

# Enable Revit Elements
from Revit.Elements import *

# EXTENSION Enable Geometry Conversion Methods
clr.ImportExtensions(Revit.GeometryConversion)

# Enable Revit API
clr.AddReference('RevitAPI')
from Autodesk.Revit.DB import *

# Enable DocumentManager and TransactionManager
clr.AddReference('RevitServices')
from RevitServices.Persistence import DocumentManager
from RevitServices.Transactions import TransactionManager

# Enable ICollection List Translate
clr.AddReference("System")
import System.Collections.Generic
from System.Collections.Generic import List

def tolist(obj1):
	if hasattr(obj1,'__iter__'): return obj1
	else: return [obj1]

doc = DocumentManager.Instance.CurrentDBDocument

if IN[0] == None:
	OUT = []
elif len(IN[0]) == 0:
	OUT = []
else:
	forms = UnwrapElement(tolist(IN[0]))
	if int(DocumentManager.Instance.CurrentUIApplication.Application.VersionNumber) < 2021:
		thickness = UnitUtils.ConvertToInternalUnits(IN[1],doc.GetUnits().GetFormatOptions(UnitType.UT_Length).DisplayUnits)
	else:
		thickness = UnitUtils.ConvertToInternalUnits(IN[1],doc.GetUnits().GetFormatOptions(SpecTypeId.Length).GetUnitTypeId())
	delete = IN[2]
	single = IN[3]
	result  = []
	TransactionManager.Instance.EnsureInTransaction(doc)
	opt1 = Options()
	if single:
		curveArrArray = CurveArrArray()
		for f in forms:
			try:
				curveloops = f.Sketch.Profile
				for loop in curveloops:
					curveArray1 = CurveArray()
					for c in loop:
						curveArray1.Append(c)
					curveArrArray.Append(curveArray1)
				skp = f.Sketch.SketchPlane
			except:
				result.append(None)
		solid1 = doc.FamilyCreate.NewExtrusion(True, curveArrArray, skp, thickness)
		result.append(solid1)
		if delete:
			for f in forms:
				doc.Delete(f.Id)
	else:
		for f in forms:
			try:
				curveArrArray = CurveArrArray()
				curveloops = f.Sketch.Profile
				for loop in curveloops:
					curveArray1 = CurveArray()
					for c in loop:
						curveArray1.Append(c)
					curveArrArray.Append(curveArray1)
				solid1 = doc.FamilyCreate.NewExtrusion(True, curveArrArray, f.Sketch.SketchPlane, thickness)
				result.append(solid1)
				if delete:
					doc.Delete(f.Id)
			except:
				result.append(None)
	TransactionManager.Instance.TransactionTaskDone()
	
	OUT = result
# ----------------------------------------
