# Dynamo graph Editor.Extrusion By Curves Selection.dyn (Dynamo 2.13.1.3887)
# author: karam@aecedx.com
# packages: Synthesize toolkit 12.5.1

# group: Input
n01_select_curves = DSModelElementsSelection()  # "01.Select Curves"; nothing selected; graph input
offset = DoubleInput(0)  # "02.Offset"; graph input

curves = Element.Curves(element=n01_select_curves)
flatten = List.Flatten(list=curves)
al_group_curves = Custom[AL.Group Curves](VARCurves=flatten)  # package Synthesize toolkit; This node will take any input of flat list of curves and group them into sublists containing "joinable" curves that is continous curves. They might form closed curves or open curves. Use PolyCurve.ByJoinedCurves to convert output groups of curves into single PolyCurves
as_polycurve_bycurves = Custom[AS.[&] PolyCurve.ByCurves](VARcurves=al_group_curves@L2)  # package Synthesize toolkit; Create polycurves from an unordered list of curves.
closeWithLine = PolyCurve.CloseWithLine(polyCurve=as_polycurve_bycurves.VARpolyCurve)
flatten_2 = List.Flatten(list=closeWithLine)
curves_2 = PolyCurve.Curves(polyCurve=flatten_2)
curves_offset_to_revit = Custom[Curves Offset To Revit Compatibility](VARCurves=curves_2, VAROffset=offset)  # package Synthesize toolkit; Curves Offset To Revit Compatibility
byPatch = Surface.ByPatch(closedCurve=flatten_2)
code_block = CodeBlock { 0.5; }
pointAtParameter = Surface.PointAtParameter(surface=byPatch, u=code_block, v=code_block)
normalAtPoint = Surface.NormalAtPoint(surface=byPatch, point=pointAtParameter)
byOriginNormal = Plane.ByOriginNormal(origin=pointAtParameter, normal=normalAtPoint)
byPlane = SketchPlane.ByPlane(plane=byOriginNormal)
revit_extrusion_by_curve_and = Custom[Revit Extrusion By Curve and Sketchplane](VARCurves=curves_offset_to_revit.VARCurves@L2, VARSketchPlane=byPlane@L1)  # package Synthesize toolkit; Revit Extrusion By Curve and Sketchplane
code_block_2 = CodeBlock { false; }
clean = List.Clean(list=revit_extrusion_by_curve_and, preserveIndices=code_block_2)
count = List.Count(list=clean)

# group: Report
n01_number_of_extrusions_created = Watch(count)  # "01.Number of Extrusions Created"; graph output

debug_python = Custom[Debug Python]()  # package Synthesize toolkit; Debug Python
