# Dynamo graph Editor.Extrusion By Infraworks Buildings (Direct SAT Import).dyn (Dynamo 2.13.1.3887)
# author: karam@aecedx.com
# packages: Synthesize toolkit 12.5.1

# group: Input
n01_sat_file = Filename("No file selected.")  # "01.SAT File"; graph input

importFromSAT = Geometry.ImportFromSAT(file=n01_sat_file)
flatten = List.Flatten(list=importFromSAT)
explode = Geometry.Explode(geometry=flatten)
flatten_2 = List.Flatten(list=explode)
code_block = CodeBlock { "Surface"; }
byClassName = Custom[SP.Filter.ByClassName](VARobject=flatten_2, VARclassName=code_block)  # package Synthesize toolkit; Filters a list of objects by the object's class name. Note that Dynamo elements belong to different classes than their Revit counterparts. Use the Object.Class node to check an object's class.
filterByOrientation = Custom[CW.Surface.FilterByOrientation](VARsurfaces=byClassName.VARin)  # package Synthesize toolkit; Sorts surfaces in three lists based on their orientation (vertical, horizontal up & horizontal down) and also returns three corresponding lists of booleans.
flatten_3 = List.Flatten(list=filterByOrientation.VARhorizontalUp)
flatten_4 = List.Flatten(list=filterByOrientation.VARhorizontalDown)
python_script = Python(IN[0]=flatten_3, IN[1]=flatten_4)  # IronPython2
# ---------- python_script.python (108 lines) ----------
# Created By Karam Baki : karam@aecedx.com
# Enable Python support and load DesignScript library
# IMPORTANT : ALL DYNAMO DESIGN SCRIPT NODES ARE AS (dg)
import clr
clr.AddReference('ProtoGeometry')
from Autodesk.DesignScript import Geometry as dg
import math

# EXTENSION Enable ToDSType
clr.AddReference('RevitNodes')
import Revit
clr.ImportExtensions(Revit.Elements)

# Enable Revit Elements
from Revit.Elements import *

# EXTENSION Enable Geometry Conversion Methods
clr.ImportExtensions(Revit.GeometryConversion)

# Enable Revit API
clr.AddReference('RevitAPI')
from Autodesk.Revit.DB import *

# Enable DocumentManager and TransactionManager
clr.AddReference('RevitServices')
from RevitServices.Persistence import DocumentManager
from RevitServices.Transactions import TransactionManager

# Enable ICollection List Translate
clr.AddReference("System")
import System.Collections.Generic
from System.Collections.Generic import List
from itertools import combinations

# Choose The Current Document
doc = DocumentManager.Instance.CurrentDBDocument
uidoc = DocumentManager.Instance.CurrentUIApplication.ActiveUIDocument
uiapp = DocumentManager.Instance.CurrentUIApplication
app = uiapp.Application

# Create Empty List
result = []

hordownsurfs = IN[0]
horupsurfs = IN[1]

downpts = []
for each in hordownsurfs:
	downpts.append(dg.Surface.PointAtParameter(each,0.5,0.5))

uppts = []
for each in horupsurfs:
	uppts.append(dg.Surface.PointAtParameter(each,0.5,0.5))

points = downpts + uppts
surfs = hordownsurfs + horupsurfs

pairs = combinations(points,2)
surfpairs = combinations(surfs,2)

subextract = []
for each in surfpairs:
	subextract.append(each)


TransactionManager.Instance.EnsureInTransaction(doc)
count = 0
for each in pairs:
	x1 = round(each[0].X,2)
	x2 = round(each[1].X,2)
	y1 = round(each[0].Y,2)
	y2 = round(each[1].Y,2)
	if x1 == x2 and y1 == y2:
		curs = dg.Surface.PerimeterCurves(subextract[count][1])
		master = CurveArrArray()
		arr = CurveArray()
		for e in curs:
			arr.Append(e.ToRevitType())
		master.Append(arr)
		try:
			l = dg.Line.ByStartPointEndPoint(each[0],each[1]).Length
			sketchplane = SketchPlane.Create(doc,dg.Plane.ByOriginNormal(each[1],dg.Vector.ZAxis()).ToPlane())
			if int(DocumentManager.Instance.CurrentUIApplication.Application.VersionNumber) < 2021:
				unittype = UnitType.UT_Length
				formatoptions = doc.GetUnits().GetFormatOptions(unittype)
				dispunits = formatoptions.DisplayUnits
				extval = UnitUtils.ConvertToInternalUnits(l,dispunits)
			else:
				extval = UnitUtils.ConvertToInternalUnits(l,doc.GetUnits().GetFormatOptions(SpecTypeId.Length).GetUnitTypeId())
			extru = doc.FamilyCreate.NewExtrusion(True, master, sketchplane, extval)
			result.append(extru)
			sketchplane.Dispose()
			count = count + 1
		except:
			pass
			count = count + 1
	else:
		count = count + 1

TransactionManager.Instance.TransactionTaskDone()

for each in hordownsurfs:
	each.Dispose()

for each in horupsurfs:
	each.Dispose()

OUT = result
# ----------------------------------------
debug_python = Custom[Debug Python]()  # package Synthesize toolkit; Debug Python
