# Dynamo graph Export.FBX Export By Family and Type.dyn (Dynamo 2.13.1.3887)
# author: karam@aecedx.com
# packages: Synthesize toolkit 12.5.1

al_current_document = Custom[AL.Current Document]()  # package Synthesize toolkit; Retrieves Current Document
get_document_name = Custom[Get Document Name](VARDocument=al_current_document)  # package Synthesize toolkit; Get Document Name
isNull = Object.IsNull(object=get_document_name.VARName)
code_block = CodeBlock { ".rvt"; " "; "Please Save Your Project Before Exporting"; }
empty = List.Empty()
scopeIf = Custom[CW.ScopeIf+](VARtest=isNull, VARtrue=code_block.out2, VARfalse=empty)  # package Synthesize toolkit; A (hopefully) more robust implementation of ScopeIf. Tests a single boolean and returns a value accordingly.
alert_popup = Custom[Alert Popup](VARMessage=scopeIf)  # package Synthesize toolkit; Popup a message dialog in Revit

# group: Input
n05_3d_view_to_create_and_hide = StringInput("K-Export 3D 1")  # "05.3D View to Create and Hide Exported Elements Inside"; graph input
n06_indication_proxy_family = FamilyTypes("Sample Proxy:Sample Proxy")  # "06.Indication Proxy Family"; graph input
n02_all_elements_of_family_name = BoolSelector(true)  # "02.All Elements of Family Name (All types) ?"; graph input
n01_family_names_separate_by = StringInput("Family")  # "01.Family Names (Separate By Comma , - or * To Select All Matching)"; graph input
n03_specific_type_names_separate = StringInput("Type")  # "03.Specific Type Names (Separate by Comma , )"; graph input
n04_elements_in_active_view_only = BoolSelector(false)  # "04.Elements In Active View Only ?"; graph input
n09_positioning_system_false_base = BoolSelector(false)  # "09.Positioning System : False = Base Point | True = Survey Point"; graph input
n10_export_method_1_main_families = IntegerSlider(1, range=1..3 step 1)  # "10.Export Method : 1 = Main Families | 2 = Shared Families | 3 = Main With It's Shared Families"; graph input
n07_directory_path_to_use_for = Directory("No file selected.")  # "07.Directory Path to Use For Export"; graph input
n08_separation_method_false = BoolSelector(false)  # "08.Separation Method : False = Family Types | True = Categories"; graph input
n11_adjust_light_source_distance = DoubleInput(0.05)  # "11.Adjust Light Source Distance"; graph input

hot_get_all_filter = Custom[HOT.Get All Filter]()  # package Synthesize toolkit; Get all Filter
code_block_2 = CodeBlock { "Dynamo "; " View "; }
code_block_3 = CodeBlock { true; "Exported Elements"; }
code_block_4 = CodeBlock(a=code_block_2.out0, b=n05_3d_view_to_create_and_hide, c=code_block_2.out1, d=code_block_3.out1) { a+b+c+d; }
eq = hot_get_all_filter.VARName == code_block_4
filterByBoolMask = List.FilterByBoolMask(list=hot_get_all_filter.VARElement, mask=eq)
code_block_5 = CodeBlock { "Dynamo "; " View "; }
code_block_6 = CodeBlock { true; "Exported Lights"; }
code_block_7 = CodeBlock(a=code_block_5.out0, b=n05_3d_view_to_create_and_hide, c=code_block_5.out1, d=code_block_6.out1) { a+b+c+d; }
eq_2 = hot_get_all_filter.VARName == code_block_7
filterByBoolMask_2 = List.FilterByBoolMask(list=hot_get_all_filter.VARElement, mask=eq_2)
create = List.Create(item0=filterByBoolMask.in, item1=filterByBoolMask_2.in)
code_block_8 = CodeBlock { false; }
clean = List.Clean(list=create, preserveIndices=code_block_8)
flatten = List.Flatten(list=clean)
python_script = Python(IN[0]=n05_3d_view_to_create_and_hide, IN[1]=flatten)  # IronPython2
# ---------- python_script.python (56 lines) ----------
#Created By Karam Baki : karam@aecedx.com

import clr
clr.AddReference('ProtoGeometry')
from Autodesk.DesignScript.Geometry import *

# Import DocumentManager and TransactionManager
clr.AddReference("RevitServices")
import RevitServices
from RevitServices.Persistence import DocumentManager
from RevitServices.Transactions import TransactionManager

# Import RevitAPI
clr.AddReference("RevitAPI")
import Autodesk
from Autodesk.Revit.DB import *

from System.Collections.Generic import *

clr.AddReference("RevitNodes")
import Revit
clr.ImportExtensions(Revit.Elements)

dataEnteringNode = IN

doc = DocumentManager.Instance.CurrentDBDocument
uiapp = DocumentManager.Instance.CurrentUIApplication
app = uiapp.Application

collector = FilteredElementCollector(doc)
views = collector.OfClass(View).ToElements()

threedename = IN[0]

status = False

views = collector.OfClass(View).ToElements()
for v in views:
	if v.ViewType == ViewType.ThreeD and v.Name == threedename:
		status = True
		break

if status == False:
	# Start a Transaction with Current Document (doc)
	TransactionManager.Instance.EnsureInTransaction(doc)
	try:
		for i in IN[1]:
			item = UnwrapElement(i).Id
			doc.Delete(item)
	except:
		pass
	# End the Transaction with Current Document ()
	TransactionManager.Instance.TransactionTaskDone()

#Assign your output to the OUT variable
OUT = status
# ----------------------------------------
code_block_9 = CodeBlock { ","; }
family_and_type_selector = Custom[Family and Type Selector](VARAllElementsofFamilyNameAlltypes=n02_all_elements_of_family_name, VARFamilyName=n01_family_names_separate_by, VARSpecificTypeNamesSeparatebySymbol=n03_specific_type_names_separate, VARSeparationSymbol=code_block_9, VAROnlyInActiveView=n04_elements_in_active_view_only)  # package Synthesize toolkit; Family and Type Selector
flatten_2 = List.Flatten(list=family_and_type_selector.VARElements)
python_script_2 = Python(IN[0]=n06_indication_proxy_family, IN[1]=flatten_2)  # IronPython2
# ---------- python_script_2.python (87 lines) ----------
# Created By Karam Baki : karam@aecedx.com
# Enable Python support and load DesignScript library
# IMPORTANT : ALL DYNAMO DESIGN SCRIPT NODES ARE AS (dg)
import clr
clr.AddReference('ProtoGeometry')
from Autodesk.DesignScript import Geometry as dg

# EXTENSION Enable ToDSType
clr.AddReference('RevitNodes')
import Revit
clr.ImportExtensions(Revit.Elements)

# Enable Revit Elements
from Revit.Elements import *

# EXTENSION Enable Geometry Conversion Methods
clr.ImportExtensions(Revit.GeometryConversion)

# Enable Revit API
clr.AddReference('RevitAPI')
from Autodesk.Revit.DB import *
from Autodesk.Revit.DB.Architecture import *
# Enable DocumentManager and TransactionManager
clr.AddReference('RevitServices')
from RevitServices.Persistence import DocumentManager
from RevitServices.Transactions import TransactionManager

# Enable ICollection List Translate
clr.AddReference("System")
import System.Collections.Generic
from System.Collections.Generic import List

from Autodesk.Revit.DB.Structure import StructuralType

clr.AddReference("RevitAPIUI")
from Autodesk.Revit.UI import TaskDialog

title = "AECedx - Karam"

# Choose The Current Document
doc = DocumentManager.Instance.CurrentDBDocument
uidoc = DocumentManager.Instance.CurrentUIApplication.ActiveUIDocument
uiapp = DocumentManager.Instance.CurrentUIApplication
app = uiapp.Application

def tolist(obj1):
	if hasattr(obj1,'__iter__'): return obj1
	else: return [obj1]

famtypes = UnwrapElement(tolist(IN[0]))
elems = IN[1]

def isworkplane(famtype):
	if not famtype.IsActive: famtype.Activate()
	try:
		test = doc.Create.NewFamilyInstance(XYZ(0,0,0), famtype, StructuralType.NonStructural)
		eachparams = test.GetOrderedParameters()
		workplanebased = False
		for epms in eachparams:
			pname = epms.Definition.Name
			if pname == "Work Plane":
					workplanebased = True
		doc.Delete(test.Id)
	except:
		workplanebased = False
	
	return workplanebased

TransactionManager.Instance.EnsureInTransaction(doc)
workplaneslist = []
for famtype in famtypes:
	if isworkplane(famtype) == False:
		workplaneslist.append(famtype.FamilyName + " (Is Not Workplane Based)")
TransactionManager.Instance.TransactionTaskDone()

temp_list = []
for i in workplaneslist:
    if i not in temp_list:
        temp_list.append(i)
workplaneslist = temp_list

if len(workplaneslist) > 0:
	workplaneslist.Insert(0,"You using Invalid Proxy Family, Please Load A Valid One.\n")
	msg = "\n".join(workplaneslist)
	OUT = TaskDialog.Show(title, msg)
else:
	OUT = IN[0],IN[1]
# ----------------------------------------
code_block_10 = CodeBlock(a=python_script_2) { a[0]; a[1]; }
scopeIf_2 = Custom[CW.ScopeIf+](VARtest=isNull, VARtrue=empty, VARfalse=code_block_10.out1)
turnIntoList = Custom[CW.TurnIntoList](VARunknownItem=scopeIf_2)  # package Synthesize toolkit; Turns an element (or a nested list) into a flat list
elements = Custom[CW.SelectionSet.Elements](VARselectionSet=filterByBoolMask.in)  # package Synthesize toolkit; Retrieves all elements stored in a selection set
elements_2 = Custom[CW.SelectionSet.Elements](VARselectionSet=filterByBoolMask_2.in)
create_2 = List.Create(item0=elements, item1=elements_2)
code_block_11 = CodeBlock { false; }
clean_2 = List.Clean(list=create_2, preserveIndices=code_block_11)
flatten_3 = List.Flatten(list=clean_2)
removeListFromList = Custom[RH.RemoveListFromList](VARListA=turnIntoList, VARListB=flatten_3)  # package Synthesize toolkit; This node essentially "subtracts" the contents of List B from List A to produce a new list with the unique items.
scopeIf_3 = Custom[CW.ScopeIf+](VARtest=python_script, VARtrue=removeListFromList, VARfalse=turnIntoList)
location_of_any_element_with = Custom[Location Of Any Element With Coordination System](VARElements=scopeIf_3, VARFalseBasePointTrueSurveyPoint=n09_positioning_system_false_base)  # package Synthesize toolkit; Location Of Any Element
isNull_2 = Object.IsNull(object=location_of_any_element_with.VARCoordinationSystems)
filterByBoolMask_3 = List.FilterByBoolMask(list=location_of_any_element_with.VARElements, mask=isNull_2)
code_block_12 = CodeBlock { true; false; }
isEmpty = List.IsEmpty(list=location_of_any_element_with.VARCoordinationSystems)
eq_3 = isEmpty == code_block_12.out1
create_3d_or_select_it = Custom[Create 3D or Select It](VARJustGenerate=code_block_12.out0, VARGoToggle=eq_3)  # package Synthesize toolkit; Create 3D or Select It
replace = String.Replace(string=get_document_name.VARName, searchFor=code_block.out0, replaceWith=code_block.out1)
code_block_13 = CodeBlock(a=replace, b=n05_3d_view_to_create_and_hide, c=code_block.out1) { a+b+c; }
auto_fbx_proxy = Custom[Auto FBX Proxy](VARElements=filterByBoolMask_3.out, VAR1MainFamilies2SharedFamilies3MainWithItsSharedFamilies=n10_export_method_1_main_families, VARProxyFamily=code_block_10.out0, VARViewtoExport=create_3d_or_select_it, VARExportFolderPath=n07_directory_path_to_use_for, VARprefix=code_block_13, VARFalseBasePointTrueSurveyPoint=n09_positioning_system_false_base, VARFalseSeparateByFamilyTypeTrueSeprateByCategory=n08_separation_method_false, VARMoveLightingFixturesByDistance=n11_adjust_light_source_distance)  # package Synthesize toolkit; Auto FBX Proxy
code_block_14 = CodeBlock { false; }
clean_3 = List.Clean(list=auto_fbx_proxy.VAROutPut, preserveIndices=code_block_14)
eraser = Custom[ST.Tool.Eraser](VARList=clean_3)  # package Synthesize toolkit; Try to delete any element from project
code_block_15 = CodeBlock { "Nothing to Export"; }
isEmpty_2 = List.IsEmpty(list=auto_fbx_proxy.VARFBX)
code_block_16 = CodeBlock()
# ---------- code_block_16.designscript (2 lines) ----------
"Invalid Proxy Family, Please Make CTRL+Z 3 Times, Then Retry With A Correct Proxy Family";
"Done, Go Check The Export Folder";
# ----------------------------------------
scopeIf_4 = Custom[CW.ScopeIf+](VARtest=isEmpty_2, VARtrue=code_block_16.out0, VARfalse=code_block_16.out1)
scopeIf_5 = Custom[CW.ScopeIf+](VARtest=isEmpty, VARtrue=code_block_15, VARfalse=scopeIf_4)
code_block_17 = CodeBlock { false; }
eq_4 = isEmpty == code_block_17
create_3d_or_select_it_2 = Custom[Create 3D or Select It](VARName=n05_3d_view_to_create_and_hide, VARGoToggle=eq_4)
code_block_18 = CodeBlock { true; false; }
code_block_19 = CodeBlock { false; }
eq_5 = python_script == code_block_19
python_null_2_empty = Custom[Python Null 2 Empty](VARIN=auto_fbx_proxy.VARElements)  # package Synthesize toolkit; Python Null 2 Empty
python_null_2_empty_2 = Custom[Python Null 2 Empty](VARIN=auto_fbx_proxy.VARElements)
getCategory = Element.GetCategory(element=python_null_2_empty_2)
string_from_object = FromObject(obj=getCategory)
code_block_20 = CodeBlock { "Lighting Fixtures"; }
eq_6 = string_from_object == code_block_20
filterByBoolMask_4 = List.FilterByBoolMask(list=python_null_2_empty, mask=eq_6)
python_empty_2_null = Custom[Python Empty 2 Null](VARIN=filterByBoolMask_4.out)  # package Synthesize toolkit; Python Null 2 Empty
generate_selection_filter = Custom[Generate Selection Filter](VARCreateSelectionFilter=code_block_3.out0, VARFilterNametoCreate=code_block_4, VAROverwriteExistingFilter=eq_5, VARElements=python_empty_2_null)  # package Synthesize toolkit; Generate Selection FIlter
list_firstitem_fixer = Custom[List.FirstItem Fixer](VARlist=generate_selection_filter.VARSelectionSetId)  # package Synthesize toolkit; List.FirstItem Fixer
hot_view_set_filter_visibility = Custom[HOT.View Set Filter Visibility](VARView=create_3d_or_select_it_2, VARVisibility=code_block_18.out0, VARFilterId=list_firstitem_fixer)  # package Synthesize toolkit; Set View Filter Visibility
end = Revit.Transaction.Transaction.End(input=hot_view_set_filter_visibility)
list_firstitem_fixer_2 = Custom[List.FirstItem Fixer](VARlist=end)
hot_view_set_filter_visibility_2 = Custom[HOT.View Set Filter Visibility](VARView=list_firstitem_fixer_2, VARVisibility=code_block_18.out1, VARFilterId=list_firstitem_fixer)
passthrough = Custom[CW.Passthrough](VARpassThrough=scopeIf_5, VARwaitFor=hot_view_set_filter_visibility_2)  # package Synthesize toolkit; Forces a sequential order of execution. The node wired into the output of the Passthrough node will be executed *after* the node wired into the waitFor input (e.g. important for some Revit operations). The value of the passThrough input will be passed on to the node wired into the output port of the Passthrough node.
end_2 = Revit.Transaction.Transaction.End(input=passthrough)
alert_popup_2 = Custom[Alert Popup](VARMessage=end_2)
python_empty_2_null_2 = Custom[Python Empty 2 Null](VARIN=filterByBoolMask_4.in)
generate_selection_filter_2 = Custom[Generate Selection Filter](VARCreateSelectionFilter=code_block_3.out0, VARFilterNametoCreate=code_block_7, VAROverwriteExistingFilter=eq_5, VARElements=python_empty_2_null_2)
list_firstitem_fixer_3 = Custom[List.FirstItem Fixer](VARlist=generate_selection_filter_2.VARSelectionSetId)
hot_view_set_filter_visibility_3 = Custom[HOT.View Set Filter Visibility](VARView=create_3d_or_select_it_2, VARVisibility=code_block_18.out0, VARFilterId=list_firstitem_fixer_3)
debug_python = Custom[Debug Python]()  # package Synthesize toolkit; Debug Python
