# Dynamo graph Export.SAT By All Elements of Active View.dyn (Dynamo 2.13.1.3887)
# author: karam@aecedx.com
# packages: Synthesize toolkit 12.5.1

# group: Input
n02_flip_orientation = BoolSelector(false)  # "02.Flip Orientation"; graph input
n01_file_path = StringInput("D:\ExportedGeometry.sat")  # "01.File Path"; graph input

code_block = CodeBlock { null; }
python_all_elements_in_active = Custom[Python All Elements In Active View]()  # package Synthesize toolkit; Python All Elements In Active View
geometry = Element.Geometry(element=python_all_elements_in_active)
code_block_2 = CodeBlock { false; }
clean = List.Clean(list=geometry, preserveIndices=code_block_2)
flatten = List.Flatten(list=clean)
scopeIf = Custom[CW.ScopeIf+](VARtest=n02_flip_orientation, VARtrue=code_block, VARfalse=flatten)  # package Synthesize toolkit; A (hopefully) more robust implementation of ScopeIf. Tests a single boolean and returns a value accordingly.
scopeIf_2 = Custom[CW.ScopeIf+](VARtest=n02_flip_orientation, VARtrue=flatten, VARfalse=code_block)
turnIntoList = Custom[CW.TurnIntoList](VARunknownItem=scopeIf_2)  # package Synthesize toolkit; Turns an element (or a nested list) into a flat list
code_block_3 = CodeBlock { false; }
clean_2 = List.Clean(list=turnIntoList, preserveIndices=code_block_3)
number = DoubleInput(1)
byCoordinates = Vector.ByCoordinates(y=number, z=number)
byOriginNormal = Plane.ByOriginNormal(normal=byCoordinates)
number_2 = DoubleInput(180)
rotate = Geometry.Rotate(geometry=clean_2, basePlane=byOriginNormal, degrees=number_2)
create = List.Create(item0=scopeIf, item1=rotate)
clean_3 = List.Clean(list=create, preserveIndices=code_block_3)
flatten_2 = List.Flatten(list=clean_3)
exportToSAT = Geometry.ExportToSAT(geometry=flatten_2, filePath=n01_file_path)
count = List.Count(list=flatten)
n01_number_of_exported_elements = Watch(count)  # "01.Number of Exported Elements"; graph output
n02_exported_elements = Watch(flatten)  # "02.Exported Elements"; graph output
debug_python = Custom[Debug Python]()  # package Synthesize toolkit; Debug Python
