# Dynamo graph Fabricate.K-Section on Batch Elements By Selection Filter.dyn (Dynamo 2.13.1.3887)
# author: karam@aecedx.com
# packages: Synthesize toolkit 12.5.1

# group: Input
n12_create_filled_regions = BoolSelector(false)  # "12.Create Filled Regions ?"; graph input
n11_subface_sequence_start = DoubleInput(1)  # "11.Subface Sequence Start"; graph input
n08_prefix_to_add = StringInput("Panel ")  # "08.Prefix to Add"; graph input
n01_selection_filter_to_read = StringInput("Fitler Name")  # "01.Selection Filter to Read"; graph input
n07_parameter_to_use_for_view = StringInput("Mark")  # "07.Parameter to use for View Name"; graph input
n10_subface_name = StringInput("Face ")  # "10.Subface Name"; graph input
n09_suffix_to_add = StringInput(" ")  # "09.Suffix to Add"; graph input
n02_method_1_vertical_faces_2 = IntegerSlider(4, range=1..4 step 1)  # "02.Method (1 = Vertical Faces | 2 = Horizontal Up Faces | 3 = Horizontal Down Faces | 4 = All Faces)"; graph input
n03_include_surfaces_with_area = DoubleInput(5)  # "03.Include Surfaces with Area Greater than"; graph input
n21_activate_far_clipping = BoolSelector(true)  # "21.Activate Far Clipping ?"; graph input
n24_flip_section = BoolSelector(false)  # "24.Flip Section ?"; graph input
n23_section_location_front_offset = DoubleInput(1)  # "23.Section Location Front Offset"; graph input
n22_far_clip_offset = DoubleInput(100)  # "22.Far Clip Offset"; graph input
n25_proceed = BoolSelector(false)  # "25.Proceed ?"; graph input
n06_crop_region_segmentation = DoubleInput(10)  # "06.Crop Region Segmentation Distance For Non-Streight Lines (Square Crop Region Must Be Off)"; graph input
n04_crop_region_offset = DoubleInput(2)  # "04.Crop Region Offset"; graph input
n13_select_filled_region_type = FilledRegionTypes("Solid Black")  # "13.Select Filled Region Type"; graph input
n18_dimension_type_number_check = DoubleInput(7)  # "18.Dimension Type Number (Check Numbers Before Proceed)"; graph input
n17_place_auto_dimensions = BoolSelector(false)  # "17.Place Auto Dimensions"; graph input
n19_number_of_digits_of_text_for = DoubleInput(3)  # "19.Number of Digits of Text for Dimensioning Non-Linear Lines"; graph input
n20_suffix_of_text_for = StringInput("")  # "20.Suffix of Text for Dimensioning Non-Linear Lines"; graph input
n14_place_model_text = BoolSelector(false)  # "14.Place Model Text ?"; graph input
n15_family_types = FamilyTypes()  # "15.Family Types"; nothing selected; graph input
n16_text_parameter_for_model_text = StringInput("Text")  # "16.Text Parameter for Model Text"; graph input
n05_square_crop_region_false_will = BoolSelector(true)  # "05.Square Crop Region ? (False Will Make Dynamo Try to Crop According to the Surfaces"; graph input

hot_get_all_filter = Custom[HOT.Get All Filter]()  # package Synthesize toolkit; Get all Filter
toLower = String.ToLower(string=hot_get_all_filter.VARName)
trimWhitespace = String.TrimWhitespace(string=toLower)
toLower_2 = String.ToLower(string=n01_selection_filter_to_read)
trimWhitespace_2 = String.TrimWhitespace(string=toLower_2)
eq = trimWhitespace == trimWhitespace_2
filterByBoolMask = List.FilterByBoolMask(list=hot_get_all_filter.VARElement, mask=eq)
elements = Custom[CW.SelectionSet.Elements](VARselectionSet=filterByBoolMask.in)  # package Synthesize toolkit; Retrieves all elements stored in a selection set
flatten = List.Flatten(list=elements)
getParameterValueByName = Element.GetParameterValueByName(element=flatten, parameterName=n07_parameter_to_use_for_view)
string_from_object = FromObject(obj=getParameterValueByName)
code_block = CodeBlock { ""; }
eq_2 = code_block == string_from_object
filterByBoolMask_2 = List.FilterByBoolMask(list=string_from_object, mask=eq_2)
code_block_2 = CodeBlock { 4; 1; 2; 3; null; false; }
eq_3 = n02_method_1_vertical_faces_2 == code_block_2.out0
filterByBoolMask_3 = List.FilterByBoolMask(list=flatten, mask=eq_2)
faces = Element.Faces(element=filterByBoolMask_3.out)
scopeIf = Custom[CW.ScopeIf+](VARtest=eq_3, VARtrue=faces, VARfalse=code_block_2.out4)  # package Synthesize toolkit; A (hopefully) more robust implementation of ScopeIf. Tests a single boolean and returns a value accordingly.
eq_4 = n02_method_1_vertical_faces_2 == code_block_2.out1
filterByOrientation = Custom[CW.Surface.FilterByOrientation](VARsurfaces=faces)  # package Synthesize toolkit; Sorts surfaces in three lists based on their orientation (vertical, horizontal up & horizontal down) and also returns three corresponding lists of booleans.
code_block_3 = CodeBlock { false; }
clean = List.Clean(list=filterByOrientation.VARvertical, preserveIndices=code_block_3)
scopeIf_2 = Custom[CW.ScopeIf+](VARtest=eq_4, VARtrue=clean, VARfalse=code_block_2.out4)
eq_5 = n02_method_1_vertical_faces_2 == code_block_2.out2
clean_2 = List.Clean(list=filterByOrientation.VARhorizontalUp, preserveIndices=code_block_3)
scopeIf_3 = Custom[CW.ScopeIf+](VARtest=eq_5, VARtrue=clean_2, VARfalse=code_block_2.out4)
eq_6 = n02_method_1_vertical_faces_2 == code_block_2.out3
clean_3 = List.Clean(list=filterByOrientation.VARhorizontalDown, preserveIndices=code_block_3)
scopeIf_4 = Custom[CW.ScopeIf+](VARtest=eq_6, VARtrue=clean_3, VARfalse=code_block_2.out4)
create = List.Create(item0=scopeIf, item1=scopeIf_2, item2=scopeIf_3, item3=scopeIf_4)
clean_4 = List.Clean(list=create, preserveIndices=code_block_2.out5)
flatten_2 = List.Flatten(list=clean_4@L2)
k_section = Custom[K-Section](VARSubfaceSequenceStart=n11_subface_sequence_start, VARPrefixtoAdd=n08_prefix_to_add, VARPanelsMarkName=filterByBoolMask_2.out, VARSubfaceName=n10_subface_name, VARSuffixtoAdd=n09_suffix_to_add, VARSurfaces=flatten_2, VARIncludeSurfaceswithAreaGreaterthan=n03_include_surfaces_with_area, VARActivateFarClipping=n21_activate_far_clipping, VARFlipSection=n24_flip_section, VARSectionLocationFrontOffset=n23_section_location_front_offset, VARFarClipOffset=n22_far_clip_offset, VARProceed=n25_proceed)  # package Synthesize toolkit; K-Section
empty = List.Empty()
scopeIf_5 = Custom[CW.ScopeIf+](VARtest=n12_create_filled_regions, VARtrue=k_section.VARSectionView, VARfalse=empty)
k_section_lines_prepare = Custom[K-Section Lines Prepare](VARSurface=k_section.VARSurface, VARCropRegionSegmentationDistanceForNonStreightLines=n06_crop_region_segmentation, VARCropRegionOffset=n04_crop_region_offset, VARPlanes=k_section.VARPlanes, VARSectionViews=k_section.VARSectionView)  # package Synthesize toolkit; K-Section Lines Prepare
scopeIf_6 = Custom[CW.ScopeIf+](VARtest=n12_create_filled_regions, VARtrue=k_section_lines_prepare.VARFilledRegionCurves, VARfalse=empty)
scopeIf_7 = Custom[CW.ScopeIf+](VARtest=n12_create_filled_regions, VARtrue=n13_select_filled_region_type, VARfalse=empty)
k_section_filled_region = Custom[K-Section Filled Region](VARSectionView=scopeIf_5, VARFilledRegionCurves=scopeIf_6, VARFilledRegionType=scopeIf_7)  # package Synthesize toolkit; K-Section Filled Region
count = List.Count(list=k_section.VARFaces)
k_section_dimensions = Custom[K-Section Dimensions](VARDimensionTypeNumber=n18_dimension_type_number_check, VARPlaceAutoDimensions=n17_place_auto_dimensions, VARSectionView=k_section.VARSectionView, VARrealCurves=k_section_lines_prepare.VARrealCurves, VARNumberofDigitsofTextforDimensioningNonLinearLines=n19_number_of_digits_of_text_for, VARSuffixofTextforDimensioningNonLinearLines=n20_suffix_of_text_for)  # package Synthesize toolkit; K-Section Dimensions

# group: Result
n01_number_of_sections_to = Watch(count)  # "01.Number of Sections to Generate"; graph output
n02_dimension_type_numbers = Watch(k_section_dimensions.VARDimensionTypeNumbers)  # "02.Dimension Type Numbers"; graph output

scopeIf_8 = Custom[CW.ScopeIf+](VARtest=n14_place_model_text, VARtrue=k_section.VARFaces, VARfalse=empty)
byGeometry = ImportInstance.ByGeometry(geometry=scopeIf_8)
scopeIf_9 = Custom[CW.ScopeIf+](VARtest=n14_place_model_text, VARtrue=n15_family_types, VARfalse=empty)
faces_2 = Element.Faces(element=byGeometry)
code_block_4 = CodeBlock { 0.5; }
surface_tangentatvparameter = Custom[Surface.TangentAtVParameter Fixer](VARSurface=faces_2, VARdouble=code_block_4)  # package Synthesize toolkit; Surface.TangentAtVParameter Fixer
byFace = FamilyInstance.ByFace(familyType=scopeIf_9, face=faces_2, location=k_section.VARLocations, referenceDirection=surface_tangentatvparameter)
setParameterByName = Element.SetParameterByName(element=byFace, parameterName=n16_text_parameter_for_model_text, value=k_section.VARNames)
passthrough = Custom[CW.Passthrough](VARpassThrough=byGeometry, VARwaitFor=setParameterByName)  # package Synthesize toolkit; Forces a sequential order of execution. The node wired into the output of the Passthrough node will be executed *after* the node wired into the waitFor input (e.g. important for some Revit operations). The value of the passThrough input will be passed on to the node wired into the output port of the Passthrough node.
eraser = Custom[ST.Tool.Eraser](VARList=passthrough)  # package Synthesize toolkit; Try to delete any element from project
square_crop_region_curves_by = Custom[Square Crop Region Curves By Surface](VARSurfaces=k_section.VARSurface, VAROffset=n04_crop_region_offset)  # package Synthesize toolkit; Square Crop Region Curves By Surface
scopeIf_10 = Custom[CW.ScopeIf+](VARtest=n05_square_crop_region_false_will, VARtrue=square_crop_region_curves_by, VARfalse=k_section_lines_prepare.VARCropRegionCurves)
setCropBoxCurves = Custom[MAD.View.SetCropBoxCurves](VARViews=k_section_lines_prepare.VARViewstoCrop, VARCurves=scopeIf_10)  # package Synthesize toolkit; Input views and lists of curves to set the view crop regions
hot_index_of_item = Custom[HOT.Index of item](VARList=k_section_lines_prepare.VARViewstoCrop, VARItem=setCropBoxCurves.VARFailedViews@L1)  # package Synthesize toolkit; Index of Item on List
flatten_3 = List.Flatten(list=hot_index_of_item)
itemAtIndex = Custom[SP.List.ItemAtIndex+](VARlist=k_section_lines_prepare.VARViewstoCrop, VARindex=flatten_3)  # package Synthesize toolkit; Identical to the built in node but works with negative indices
itemAtIndex_2 = Custom[SP.List.ItemAtIndex+](VARlist=k_section.VARSurface, VARindex=flatten_3)
square_crop_region_curves_by_2 = Custom[Square Crop Region Curves By Surface](VARSurfaces=itemAtIndex_2, VAROffset=n04_crop_region_offset)
setCropBoxCurves_2 = Custom[MAD.View.SetCropBoxCurves](VARViews=itemAtIndex, VARCurves=square_crop_region_curves_by_2)
debug_python = Custom[Debug Python]()  # package Synthesize toolkit; Debug Python
