# Dynamo graph Fabricate.K-Section on Single Element.dyn (Dynamo 2.13.1.3887)
# author: karam@aecedx.com
# packages: Synthesize toolkit 12.5.1

# group: Input
n13_create_filled_regions = BoolSelector(false)  # "13.Create Filled Regions ?"; graph input
n12_subface_sequence_start = DoubleInput(1)  # "12.Subface Sequence Start"; graph input
n09_prefix_to_add = StringInput("Panel ")  # "09.Prefix to Add"; graph input
n01_select_single_element = DSModelElementSelection()  # "01.Select Single Element"; nothing selected; graph input
n08_parameter_to_use_for_view = StringInput("Mark")  # "08.Parameter to use for View Name"; graph input
n11_subface_name = StringInput("Face ")  # "11.Subface Name"; graph input
n10_suffix_to_add = StringInput(" ")  # "10.Suffix to Add"; graph input
n03_method_1_vertical_faces_2 = IntegerSlider(4, range=1..4 step 1)  # "03.Method (1 = Vertical Faces | 2 = Horizontal Up Faces | 3 = Horizontal Down Faces | 4 = All Faces)"; graph input
n02_select_faces_of_element = SelectFaces()  # "02.Select Faces of Element"; nothing selected; graph input
n04_include_surfaces_with_area = DoubleInput(5)  # "04.Include Surfaces with Area Greater than"; graph input
n22_activate_far_clipping = BoolSelector(true)  # "22.Activate Far Clipping ?"; graph input
n25_flip_section = BoolSelector(false)  # "25.Flip Section ?"; graph input
n24_section_location_front_offset = DoubleInput(1)  # "24.Section Location Front Offset"; graph input
n23_far_clip_offset = DoubleInput(100)  # "23.Far Clip Offset"; graph input
n26_proceed = BoolSelector(false)  # "26.Proceed ?"; graph input
n07_crop_region_segmentation = DoubleInput(10)  # "07.Crop Region Segmentation Distance For Non-Streight Lines (Square Crop Region Must Be Off)"; graph input
n06_crop_region_offset = DoubleInput(2)  # "06.Crop Region Offset"; graph input
n14_select_filled_region_type = FilledRegionTypes("Solid Black")  # "14.Select Filled Region Type"; graph input
n19_dimension_type_number_check = DoubleInput(7)  # "19.Dimension Type Number (Check Numbers Before Proceed)"; graph input
n18_place_auto_dimensions = BoolSelector(false)  # "18.Place Auto Dimensions"; graph input
n20_number_of_digits_of_text_for = DoubleInput(3)  # "20.Number of Digits of Text for Dimensioning Non-Linear Lines"; graph input
n21_suffix_of_text_for = StringInput("")  # "21.Suffix of Text for Dimensioning Non-Linear Lines"; graph input
n15_place_model_text = BoolSelector(false)  # "15.Place Model Text ?"; graph input
n16_family_types = FamilyTypes()  # "16.Family Types"; nothing selected; graph input
n17_text_parameter_for_model_text = StringInput("Text")  # "17.Text Parameter for Model Text"; graph input
n05_square_crop_region_false_will = BoolSelector(true)  # "05.Square Crop Region ? (False Will Make Dynamo Try to Crop According to the Surfaces"; graph input

getParameterValueByName = Element.GetParameterValueByName(element=n01_select_single_element, parameterName=n08_parameter_to_use_for_view)
string_from_object = FromObject(obj=getParameterValueByName)
code_block = CodeBlock { ""; }
eq = code_block == string_from_object
filterByBoolMask = List.FilterByBoolMask(list=string_from_object, mask=eq)
code_block_2 = CodeBlock { 4; 1; 2; 3; null; false; }
eq_2 = n03_method_1_vertical_faces_2 == code_block_2.out0
isEmpty = List.IsEmpty(list=filterByBoolMask.out)
empty = List.Empty()
flatten = List.Flatten(list=n02_select_faces_of_element)
scopeIf = Custom[CW.ScopeIf+](VARtest=isEmpty, VARtrue=empty, VARfalse=flatten)  # package Synthesize toolkit; A (hopefully) more robust implementation of ScopeIf. Tests a single boolean and returns a value accordingly.
scopeIf_2 = Custom[CW.ScopeIf+](VARtest=eq_2, VARtrue=scopeIf, VARfalse=code_block_2.out4)
eq_3 = n03_method_1_vertical_faces_2 == code_block_2.out1
filterByOrientation = Custom[CW.Surface.FilterByOrientation](VARsurfaces=scopeIf)  # package Synthesize toolkit; Sorts surfaces in three lists based on their orientation (vertical, horizontal up & horizontal down) and also returns three corresponding lists of booleans.
code_block_3 = CodeBlock { false; }
clean = List.Clean(list=filterByOrientation.VARvertical, preserveIndices=code_block_3)
scopeIf_3 = Custom[CW.ScopeIf+](VARtest=eq_3, VARtrue=clean, VARfalse=code_block_2.out4)
eq_4 = n03_method_1_vertical_faces_2 == code_block_2.out2
clean_2 = List.Clean(list=filterByOrientation.VARhorizontalUp, preserveIndices=code_block_3)
scopeIf_4 = Custom[CW.ScopeIf+](VARtest=eq_4, VARtrue=clean_2, VARfalse=code_block_2.out4)
eq_5 = n03_method_1_vertical_faces_2 == code_block_2.out3
clean_3 = List.Clean(list=filterByOrientation.VARhorizontalDown, preserveIndices=code_block_3)
scopeIf_5 = Custom[CW.ScopeIf+](VARtest=eq_5, VARtrue=clean_3, VARfalse=code_block_2.out4)
create = List.Create(item0=scopeIf_2, item1=scopeIf_3, item2=scopeIf_4, item3=scopeIf_5)
clean_4 = List.Clean(list=create, preserveIndices=code_block_2.out5)
flatten_2 = List.Flatten(list=clean_4@L2)
k_section = Custom[K-Section](VARSubfaceSequenceStart=n12_subface_sequence_start, VARPrefixtoAdd=n09_prefix_to_add, VARPanelsMarkName=filterByBoolMask.out, VARSubfaceName=n11_subface_name, VARSuffixtoAdd=n10_suffix_to_add, VARSurfaces=flatten_2, VARIncludeSurfaceswithAreaGreaterthan=n04_include_surfaces_with_area, VARActivateFarClipping=n22_activate_far_clipping, VARFlipSection=n25_flip_section, VARSectionLocationFrontOffset=n24_section_location_front_offset, VARFarClipOffset=n23_far_clip_offset, VARProceed=n26_proceed)  # package Synthesize toolkit; K-Section
empty_2 = List.Empty()
scopeIf_6 = Custom[CW.ScopeIf+](VARtest=n13_create_filled_regions, VARtrue=k_section.VARSectionView, VARfalse=empty_2)
k_section_lines_prepare = Custom[K-Section Lines Prepare](VARSurface=k_section.VARSurface, VARCropRegionSegmentationDistanceForNonStreightLines=n07_crop_region_segmentation, VARCropRegionOffset=n06_crop_region_offset, VARPlanes=k_section.VARPlanes, VARSectionViews=k_section.VARSectionView)  # package Synthesize toolkit; K-Section Lines Prepare
scopeIf_7 = Custom[CW.ScopeIf+](VARtest=n13_create_filled_regions, VARtrue=k_section_lines_prepare.VARFilledRegionCurves, VARfalse=empty_2)
scopeIf_8 = Custom[CW.ScopeIf+](VARtest=n13_create_filled_regions, VARtrue=n14_select_filled_region_type, VARfalse=empty_2)
k_section_filled_region = Custom[K-Section Filled Region](VARSectionView=scopeIf_6, VARFilledRegionCurves=scopeIf_7, VARFilledRegionType=scopeIf_8)  # package Synthesize toolkit; K-Section Filled Region
count = List.Count(list=k_section.VARFaces)
k_section_dimensions = Custom[K-Section Dimensions](VARDimensionTypeNumber=n19_dimension_type_number_check, VARPlaceAutoDimensions=n18_place_auto_dimensions, VARSectionView=k_section.VARSectionView, VARrealCurves=k_section_lines_prepare.VARrealCurves, VARNumberofDigitsofTextforDimensioningNonLinearLines=n20_number_of_digits_of_text_for, VARSuffixofTextforDimensioningNonLinearLines=n21_suffix_of_text_for)  # package Synthesize toolkit; K-Section Dimensions

# group: Result
n01_number_of_sections_to = Watch(count)  # "01.Number of Sections to Generate"; graph output
n02_dimension_type_numbers = Watch(k_section_dimensions.VARDimensionTypeNumbers)  # "02.Dimension Type Numbers"; graph output

scopeIf_9 = Custom[CW.ScopeIf+](VARtest=n15_place_model_text, VARtrue=k_section.VARFaces, VARfalse=empty_2)
byGeometry = ImportInstance.ByGeometry(geometry=scopeIf_9)
scopeIf_10 = Custom[CW.ScopeIf+](VARtest=n15_place_model_text, VARtrue=n16_family_types, VARfalse=empty_2)
faces = Element.Faces(element=byGeometry)
code_block_4 = CodeBlock { 0.5; }
surface_tangentatvparameter = Custom[Surface.TangentAtVParameter Fixer](VARSurface=faces, VARdouble=code_block_4)  # package Synthesize toolkit; Surface.TangentAtVParameter Fixer
byFace = FamilyInstance.ByFace(familyType=scopeIf_10, face=faces, location=k_section.VARLocations, referenceDirection=surface_tangentatvparameter)
setParameterByName = Element.SetParameterByName(element=byFace, parameterName=n17_text_parameter_for_model_text, value=k_section.VARNames)
passthrough = Custom[CW.Passthrough](VARpassThrough=byGeometry, VARwaitFor=setParameterByName)  # package Synthesize toolkit; Forces a sequential order of execution. The node wired into the output of the Passthrough node will be executed *after* the node wired into the waitFor input (e.g. important for some Revit operations). The value of the passThrough input will be passed on to the node wired into the output port of the Passthrough node.
eraser = Custom[ST.Tool.Eraser](VARList=passthrough)  # package Synthesize toolkit; Try to delete any element from project
square_crop_region_curves_by = Custom[Square Crop Region Curves By Surface](VARSurfaces=k_section.VARSurface, VAROffset=n06_crop_region_offset)  # package Synthesize toolkit; Square Crop Region Curves By Surface
scopeIf_11 = Custom[CW.ScopeIf+](VARtest=n05_square_crop_region_false_will, VARtrue=square_crop_region_curves_by, VARfalse=k_section_lines_prepare.VARCropRegionCurves)
setCropBoxCurves = Custom[MAD.View.SetCropBoxCurves](VARViews=k_section_lines_prepare.VARViewstoCrop, VARCurves=scopeIf_11)  # package Synthesize toolkit; Input views and lists of curves to set the view crop regions
hot_index_of_item = Custom[HOT.Index of item](VARList=k_section_lines_prepare.VARViewstoCrop, VARItem=setCropBoxCurves.VARFailedViews@L1)  # package Synthesize toolkit; Index of Item on List
flatten_3 = List.Flatten(list=hot_index_of_item)
itemAtIndex = Custom[SP.List.ItemAtIndex+](VARlist=k_section_lines_prepare.VARViewstoCrop, VARindex=flatten_3)  # package Synthesize toolkit; Identical to the built in node but works with negative indices
itemAtIndex_2 = Custom[SP.List.ItemAtIndex+](VARlist=k_section.VARSurface, VARindex=flatten_3)
square_crop_region_curves_by_2 = Custom[Square Crop Region Curves By Surface](VARSurfaces=itemAtIndex_2, VAROffset=n06_crop_region_offset)
setCropBoxCurves_2 = Custom[MAD.View.SetCropBoxCurves](VARViews=itemAtIndex, VARCurves=square_crop_region_curves_by_2)
debug_python = Custom[Debug Python]()  # package Synthesize toolkit; Debug Python
