# Dynamo graph Family.Delete By Error Report.dyn (Dynamo 2.13.1.3887)
# author: karam@aecedx.com
# packages: Synthesize toolkit 12.5.1

# group: Input
n01_error_report = Filename("C:\Users\karam\Desktop\Project1_Error Report.html")  # "01.Error Report"; graph input

parse = Custom[SP.ErrorReport.Parse](VARReport=n01_error_report)  # package Synthesize toolkit; K-Warnings Read
code_block = CodeBlock { false; }
clean = List.Clean(list=parse.VARElements, preserveIndices=code_block)
flatten = List.Flatten(list=clean)
eraser = Custom[ST.Tool.Eraser](VARList=flatten)  # package Synthesize toolkit; Try to delete any element from project
debug_python_no_message = Custom[Debug Python No Message]()  # package Synthesize toolkit; Debug Python
