# Dynamo graph Family.Delete Percentage By Selection Filter.dyn (Dynamo 2.13.1.3887)
# author: karam@aecedx.com
# packages: Synthesize toolkit 12.5.1

hot_get_all_filter = Custom[HOT.Get All Filter]()  # package Synthesize toolkit; Get all Filter
toLower = String.ToLower(string=hot_get_all_filter.VARName)
trimWhitespace = String.TrimWhitespace(string=toLower)

# group: Input
n01_selection_filter_to_read = StringInput("Fitler Name")  # "01.Selection Filter to Read"; graph input
percentage = DoubleInput(25)  # "02.Percentage"; graph input

toLower_2 = String.ToLower(string=n01_selection_filter_to_read)
trimWhitespace_2 = String.TrimWhitespace(string=toLower_2)
eq = trimWhitespace == trimWhitespace_2
filterByBoolMask = List.FilterByBoolMask(list=hot_get_all_filter.VARElement, mask=eq)
elements = Custom[CW.SelectionSet.Elements](VARselectionSet=filterByBoolMask.in)  # package Synthesize toolkit; Retrieves all elements stored in a selection set
flatten = List.Flatten(list=elements)
flatten_2 = List.Flatten(list=flatten)
shuffle = List.Shuffle(list=flatten_2)
code_block = CodeBlock { 100; }
div = percentage / code_block
count = List.Count(list=flatten_2)
mul = div * count
takeItems = List.TakeItems(list=shuffle, amount=mul)
eraser = Custom[ST.Tool.Eraser](VARList=takeItems)  # package Synthesize toolkit; Try to delete any element from project

# group: Result
selected = Watch(count)  # "01.No.Selected"; graph output

debug_python = Custom[Debug Python]()  # package Synthesize toolkit; Debug Python
