# Dynamo graph Family.Delete Percentage By Selection.dyn (Dynamo 2.13.1.3887)
# author: karam@aecedx.com
# packages: Synthesize toolkit 12.5.1

# group: Input
n01_select_elements = DSModelElementsSelection()  # "01.Select Elements"; nothing selected; graph input
percentage = DoubleInput(25)  # "02.Percentage"; graph input

flatten = List.Flatten(list=n01_select_elements)
shuffle = List.Shuffle(list=flatten)
code_block = CodeBlock { 100; }
div = percentage / code_block
count = List.Count(list=flatten)
mul = div * count
takeItems = List.TakeItems(list=shuffle, amount=mul)
eraser = Custom[ST.Tool.Eraser](VARList=takeItems)  # package Synthesize toolkit; Try to delete any element from project

# group: Result
selected = Watch(count)  # "01.No.Selected"; graph output

debug_python = Custom[Debug Python]()  # package Synthesize toolkit; Debug Python
