# Dynamo graph Family.Delete Tolerance By Selection.dyn (Dynamo 2.13.1.3887)
# author: karam@aecedx.com
# packages: Synthesize toolkit 12.5.1

# group: Input
n01_select_elements = DSModelElementsSelection()  # "01.Select Elements"; nothing selected; graph input
tolerance = DoubleInput(5)  # "02.Tolerance"; graph input

flatten = List.Flatten(list=n01_select_elements)
location_of_any_element = Custom[Location Of Any Element](VARElements=flatten)  # package Synthesize toolkit; Location Of Any Element
pruneDuplicates = Point.PruneDuplicates(points=location_of_any_element.VARLocations, tolerance=tolerance)
contains = List.Contains(list=pruneDuplicates, item=location_of_any_element.VARLocations@@L1)
filterByBoolMask = List.FilterByBoolMask(list=location_of_any_element.VARElements, mask=contains)
eraser = Custom[ST.Tool.Eraser](VARList=filterByBoolMask.out)  # package Synthesize toolkit; Try to delete any element from project
count = List.Count(list=location_of_any_element.VARElements)

# group: Result
selected = Watch(count)  # "01.No.Selected"; graph output

debug_python = Custom[Debug Python]()  # package Synthesize toolkit; Debug Python
