# Dynamo graph Family.Disable Reference Planes By Selection.dyn (Dynamo 2.13.1.3887)
# author: karam@aecedx.com
# packages: Synthesize toolkit 12.5.1

debug_python = Custom[Debug Python]()  # package Synthesize toolkit; Debug Python

# group: Input
n01_select_families_to_change = DSModelElementsSelection()  # "01.Select Families to Change their Category"; nothing selected; graph input

elementType = Element.ElementType(element=n01_select_families_to_change)
flatten = List.Flatten(list=elementType)
uniqueItems = List.UniqueItems(list=flatten)
disableReferencePlanes = Custom[DisableReferencePlanes](VARFamilyTypes=uniqueItems)  # package Synthesize toolkit; DisableReferencePlanes
