# Dynamo graph Family.Family Type Smart Change By Family and Type.dyn (Dynamo 2.13.1.3887)
# author: karam@aecedx.com
# packages: Synthesize toolkit 12.5.1

# group: Input
n02_all_elements_of_family_name = BoolSelector(true)  # "02.All Elements of Family Name (All types) ?"; graph input
n01_family_names_separate_by = StringInput("Family")  # "01.Family Names (Separate By Comma , - or * To Select All Matching)"; graph input
n03_specific_type_names_separate = StringInput("Type")  # "03.Specific Type Names (Separate by Comma , )"; graph input
n04_elements_in_active_view_only = BoolSelector(false)  # "04.Elements In Active View Only ?"; graph input
n05_target_family_type = FamilyTypes()  # "05.Target Family Type"; nothing selected; graph input
n06_change_type_values_too = BoolSelector(false)  # "06.Change Type Values Too ?"; graph input
n07_full_replace_adaptive_only = BoolSelector(false)  # "07.Full Replace ? (Adaptive Only)"; graph input

code_block = CodeBlock { ","; }
family_and_type_selector = Custom[Family and Type Selector](VARAllElementsofFamilyNameAlltypes=n02_all_elements_of_family_name, VARFamilyName=n01_family_names_separate_by, VARSpecificTypeNamesSeparatebySymbol=n03_specific_type_names_separate, VARSeparationSymbol=code_block, VAROnlyInActiveView=n04_elements_in_active_view_only)  # package Synthesize toolkit; Family and Type Selector
smart_family_type_change = Custom[Smart Family Type Change](VARElements=family_and_type_selector.VARElements, VARTargetFamilyType=n05_target_family_type, VARChangeTypeValuesToo=n06_change_type_values_too, VARFullReplaceAdaptiveOnly=n07_full_replace_adaptive_only)  # package Synthesize toolkit; Smart Family Type Change
debug_python_no_message = Custom[Debug Python No Message]()  # package Synthesize toolkit; Debug Python
