# Dynamo graph Family.Family Type Smart Change By Selection Filter.dyn (Dynamo 2.13.1.3887)
# author: karam@aecedx.com
# packages: Synthesize toolkit 12.5.1

hot_get_all_filter = Custom[HOT.Get All Filter]()  # package Synthesize toolkit; Get all Filter
toLower = String.ToLower(string=hot_get_all_filter.VARName)
trimWhitespace = String.TrimWhitespace(string=toLower)

# group: Input
n01_selection_filter_to_read = StringInput("Fitler Name")  # "01.Selection Filter to Read"; graph input
n02_target_family_type = FamilyTypes()  # "02.Target Family Type"; nothing selected; graph input
n03_change_type_values_too = BoolSelector(false)  # "03.Change Type Values Too ?"; graph input
n04_full_replace_adaptive_only = BoolSelector(false)  # "04.Full Replace ? (Adaptive Only)"; graph input

toLower_2 = String.ToLower(string=n01_selection_filter_to_read)
trimWhitespace_2 = String.TrimWhitespace(string=toLower_2)
eq = trimWhitespace == trimWhitespace_2
filterByBoolMask = List.FilterByBoolMask(list=hot_get_all_filter.VARElement, mask=eq)
elements = Custom[CW.SelectionSet.Elements](VARselectionSet=filterByBoolMask.in)  # package Synthesize toolkit; Retrieves all elements stored in a selection set
flatten = List.Flatten(list=elements)
smart_family_type_change = Custom[Smart Family Type Change](VARElements=flatten, VARTargetFamilyType=n02_target_family_type, VARChangeTypeValuesToo=n03_change_type_values_too, VARFullReplaceAdaptiveOnly=n04_full_replace_adaptive_only)  # package Synthesize toolkit; Smart Family Type Change
debug_python_no_message = Custom[Debug Python No Message]()  # package Synthesize toolkit; Debug Python
