# Dynamo graph Family.Family Type Smart Change By Selection.dyn (Dynamo 2.13.1.3887)
# author: karam@aecedx.com
# packages: Synthesize toolkit 12.5.1

# group: Input
n01_select_family_instances = DSModelElementsSelection()  # "01.Select Family Instances"; nothing selected; graph input
n02_target_family_type = FamilyTypes()  # "02.Target Family Type"; nothing selected; graph input
n03_change_type_values_too = BoolSelector(false)  # "03.Change Type Values Too ?"; graph input
n04_full_replace_adaptive_only = BoolSelector(false)  # "04.Full Replace ? (Adaptive Only)"; graph input

smart_family_type_change = Custom[Smart Family Type Change](VARElements=n01_select_family_instances, VARTargetFamilyType=n02_target_family_type, VARChangeTypeValuesToo=n03_change_type_values_too, VARFullReplaceAdaptiveOnly=n04_full_replace_adaptive_only)  # package Synthesize toolkit; Smart Family Type Change
debug_python_no_message = Custom[Debug Python No Message]()  # package Synthesize toolkit; Debug Python
