# Dynamo graph Family.Flip Workplane By All Elements of Active View.dyn (Dynamo 2.13.1.3887)
# author: karam@aecedx.com
# packages: Synthesize toolkit 12.5.1

python_all_elements_in_active = Custom[Python All Elements In Active View]()  # package Synthesize toolkit; Python All Elements In Active View
n01_flip_workplane = BoolSelector(false)  # "01.Flip Workplane ?"; graph input
flipWorkplane = Custom[FlipWorkplane](VARElements=python_all_elements_in_active, VARFlip=n01_flip_workplane)  # package Synthesize toolkit; FlipWorkplane
debug_python_no_message = Custom[Debug Python No Message]()  # package Synthesize toolkit; Debug Python
