# Dynamo graph Family.Flip Workplane By Family and Type.dyn (Dynamo 2.13.1.3887)
# author: karam@aecedx.com
# packages: Synthesize toolkit 12.5.1

# group: Input
n06_all_elements_of_family_name = BoolSelector(true)  # "06.All Elements of Family Name (All types) ?"; graph input
n05_family_names_separate_by = StringInput("Family")  # "05.Family Names (Separate By Comma , - or * To Select All Matching)"; graph input
n07_specific_type_names_separate = StringInput("Type")  # "07.Specific Type Names (Separate by Comma , )"; graph input
n08_elements_in_active_view_only = BoolSelector(false)  # "08.Elements In Active View Only ?"; graph input
n09_flip_workplane = BoolSelector(false)  # "09.Flip Workplane ?"; graph input

code_block = CodeBlock { ","; }
family_and_type_selector = Custom[Family and Type Selector](VARAllElementsofFamilyNameAlltypes=n06_all_elements_of_family_name, VARFamilyName=n05_family_names_separate_by, VARSpecificTypeNamesSeparatebySymbol=n07_specific_type_names_separate, VARSeparationSymbol=code_block, VAROnlyInActiveView=n08_elements_in_active_view_only)  # package Synthesize toolkit; Family and Type Selector
flipWorkplane = Custom[FlipWorkplane](VARElements=family_and_type_selector.VARElements, VARFlip=n09_flip_workplane)  # package Synthesize toolkit; FlipWorkplane
debug_python_no_message = Custom[Debug Python No Message]()  # package Synthesize toolkit; Debug Python
python_all_elements_in_active = Custom[Python All Elements In Active View]()  # package Synthesize toolkit; Python All Elements In Active View
n04_all_elements_of_family_name = BoolSelector(true)  # "04.All Elements of Family Name (All types) ?"; graph input
n03_family_names_separate_by = StringInput("Family")  # "03.Family Names (Separate By Comma , - or * To Select All Matching)"; graph input
n02_specific_type_names_separate = StringInput("Type")  # "02.Specific Type Names (Separate by Comma , )"; graph input
code_block_2 = CodeBlock { ","; }
n01_elements_in_active_view_only = BoolSelector(false)  # "01.Elements In Active View Only ?"; graph input
family_and_type_selector_2 = Custom[Family and Type Selector](VARAllElementsofFamilyNameAlltypes=n04_all_elements_of_family_name, VARFamilyName=n03_family_names_separate_by, VARSpecificTypeNamesSeparatebySymbol=n02_specific_type_names_separate, VARSeparationSymbol=code_block_2, VAROnlyInActiveView=n01_elements_in_active_view_only)
