# Dynamo graph Family.Flip Workplane By Selection Filter.dyn (Dynamo 2.13.1.3887)
# author: karam@aecedx.com
# packages: Synthesize toolkit 12.5.1

hot_get_all_filter = Custom[HOT.Get All Filter]()  # package Synthesize toolkit; Get all Filter
toLower = String.ToLower(string=hot_get_all_filter.VARName)
trimWhitespace = String.TrimWhitespace(string=toLower)

# group: Input
n01_selection_filter_to_read = StringInput("Filter Name")  # "01.Selection Filter to Read"; graph input
n02_flip_workplane = BoolSelector(false)  # "02.Flip Workplane ?"; graph input

toLower_2 = String.ToLower(string=n01_selection_filter_to_read)
trimWhitespace_2 = String.TrimWhitespace(string=toLower_2)
eq = trimWhitespace == trimWhitespace_2
filterByBoolMask = List.FilterByBoolMask(list=hot_get_all_filter.VARElement, mask=eq)
elements = Custom[CW.SelectionSet.Elements](VARselectionSet=filterByBoolMask.in)  # package Synthesize toolkit; Retrieves all elements stored in a selection set
flatten = List.Flatten(list=elements)
flipWorkplane = Custom[FlipWorkplane](VARElements=flatten, VARFlip=n02_flip_workplane)  # package Synthesize toolkit; FlipWorkplane
debug_python_no_message = Custom[Debug Python No Message]()  # package Synthesize toolkit; Debug Python
