# Dynamo graph Family.Generate (Import Symbol or Family) By All Elements of Active View.dyn (Dynamo 2.13.1.3887)
# author: karam@aecedx.com
# packages: Synthesize toolkit 12.5.1

# group: Input
n17_create_selection_filter = BoolSelector(true)  # "17.Create Selection Filter ?"; graph input
n18_filter_name_to_create = StringInput("Dynamo Generated Import Symbol or Family")  # "18.Filter Name to Create"; graph input
n19_overwrite_existing_filter = BoolSelector(false)  # "19.Overwrite Existing Filter ? (False for Adding Elements)"; graph input
n04_family_method_one_family = BoolSelector(true)  # "04.Family Method : One Family ?"; graph input
n09_family_method_sequence_naming = BoolSelector(true)  # "09.Family Method : Sequence Naming Mode : True = Auto | False = Manual"; graph input
n02_join_adjacent_surfaces = BoolSelector(false)  # "02.Join Adjacent Surfaces ?"; graph input
n01_join_adjacent_solids = BoolSelector(false)  # "01.Join Adjacent Solids ?"; graph input
n08_family_method_family_name = StringInput("Dynamo Solid or Void Family")  # "08.Family Method : Family Name"; graph input
n10_family_method_start_sequence = DoubleInput(1)  # "10.Family Method : Start Sequence (Naming Suffix) - Manual Mode"; graph input
n14_family_method_category = Categories("OST_GenericModel")  # "14.Family Method : Category"; graph input
n16_family_method_family_template = Filename("..\..\..\..\..\..\..\..\..\..\ProgramData\Autodesk\RVT 2020\Family Templates\English\Metric Generic Model.rft")  # "16.Family Method : Family Template of The Above Category"; graph input
n06_family_method_is_shared = BoolSelector(false)  # "06.Family Method : Is Shared Family ?"; graph input
n07_family_method_to_void = BoolSelector(false)  # "07.Family Method : To Void ?"; graph input
n11_family_method_material = StringInput("")  # "11.Family Method : Material"; graph input
n13_family_method_material_single = BoolSelector(true)  # "13.Family Method : Material: Single Parameter Only ?"; graph input
n12_family_method_material_is = BoolSelector(true)  # "12.Family Method : Material: Is Instance Parameter ?"; graph input
n15_family_method_subcategory = StringInput("")  # "15.Family Method : Subcategory"; graph input
n05_family_method_self_origin = BoolSelector(true)  # "05.Family Method : Self Origin ?"; graph input
n03_method_false_import_symbol = BoolSelector(true)  # "03.Method : False = Import Symbol | True = Family"; graph input

python_all_elements_in_active = Custom[Python All Elements In Active View]()  # package Synthesize toolkit; Python All Elements In Active View
element_geometry_fast = Custom[Element.Geometry Fast](VARElements=python_all_elements_in_active)  # package Synthesize toolkit; Element.Geometry Fast
code_block = CodeBlock { false; }
clean = List.Clean(list=element_geometry_fast, preserveIndices=code_block)
flatten = List.Flatten(list=clean)
code_block_2 = CodeBlock { "Solid"; "Surface"; }
byClassName = Custom[SP.Filter.ByClassName](VARobject=flatten, VARclassName=code_block_2.out0)  # package Synthesize toolkit; Filters a list of objects by the object's class name. Note that Dynamo elements belong to different classes than their Revit counterparts. Use the Object.Class node to check an object's class.
code_block_3 = CodeBlock { false; }
clean_2 = List.Clean(list=byClassName.VARin, preserveIndices=code_block_3)
flatten_2 = List.Flatten(list=clean_2)
centroid = Solid.Centroid()  # unwired: solid
uniqueItems = List.UniqueItems(list=centroid)
groupByFunction = List.GroupByFunction(list=flatten_2, groupFunction=uniqueItems)
flatten_3 = List.Flatten(list=groupByFunction@L2)
list_firstitem_fixer = Custom[List.FirstItem Fixer](VARlist=flatten_3@L2)  # package Synthesize toolkit; List.FirstItem Fixer
byClassName_2 = Custom[SP.Filter.ByClassName](VARobject=flatten, VARclassName=code_block_2.out1)
code_block_4 = CodeBlock { false; }
clean_3 = List.Clean(list=byClassName_2.VARin, preserveIndices=code_block_4)
flatten_4 = List.Flatten(list=clean_3)
create = List.Create(item0=list_firstitem_fixer, item1=flatten_4)
code_block_5 = CodeBlock { false; }
clean_4 = List.Clean(list=create, preserveIndices=code_block_5)
flatten_5 = List.Flatten(list=clean_4)
smart_rft_path = Custom[Smart RFT Path](VARRFTFile=n16_family_method_family_template, VARCategory=n14_family_method_category)  # package Synthesize toolkit; Smart RFT Path
code_block_6 = CodeBlock { true; }
ne = code_block_6 != n03_method_false_import_symbol
k_family_insert = Custom[K-Family Insert](VARGeometryorSAT=flatten_5, VAROneFamily=n04_family_method_one_family, VARAvoidConfilct=n09_family_method_sequence_naming, VARJoinAdjacentSurfacesForcesDynamoProcessSAT=n02_join_adjacent_surfaces, VARJoinAdjacentSolidsForcesDynamoProcessSAT=n01_join_adjacent_solids, VARFamilyName=n08_family_method_family_name, VARFamilyNumber=n10_family_method_start_sequence, VARFamilyCategory=n14_family_method_category, VARFamilyTemplatePath=smart_rft_path, VARIsShared=n06_family_method_is_shared, VARToVoid=n07_family_method_to_void, VARMaterialName=n11_family_method_material, VARIsOneMaterial=n13_family_method_material_single, VARIsMaterialInstance=n12_family_method_material_is, VARSubcategory=n15_family_method_subcategory, VARSelfOrigin=n05_family_method_self_origin, VARImportInstanceInstead=ne)  # package Synthesize toolkit; K-Family Insert
flatten_6 = List.Flatten(list=k_family_insert.VARFamilyInstancesOrImportSymbols)
generate_selection_filter = Custom[Generate Selection Filter](VARCreateSelectionFilter=n17_create_selection_filter, VARFilterNametoCreate=n18_filter_name_to_create, VAROverwriteExistingFilter=n19_overwrite_existing_filter, VARElements=flatten_6)  # package Synthesize toolkit; Generate Selection FIlter
try_to_hide_elements_in_mass = Custom[Try to Hide Elements In Mass Only](VARElements=python_all_elements_in_active, VARWait=flatten_6)  # package Synthesize toolkit; Try to Hide Elements
debug_python_no_message = Custom[Debug Python No Message]()  # package Synthesize toolkit; Debug Python
