# Dynamo graph Family.Generate (Import Symbol or Family) By Solids Subtract.dyn (Dynamo 2.13.1.3887)
# author: karam@aecedx.com
# packages: Synthesize toolkit 12.5.1

# group: Input
n17_create_selection_filter = BoolSelector(true)  # "17.Create Selection Filter ?"; graph input
n18_filter_name_to_create = StringInput("Dynamo Generated Import Symbol or Family")  # "18.Filter Name to Create"; graph input
n19_overwrite_existing_filter = BoolSelector(false)  # "19.Overwrite Existing Filter ? (False for Adding Elements)"; graph input
n01_select_biggest_solid = DSModelElementSelection()  # "01.Select Biggest Solid"; nothing selected; graph input
n02_select_solids_to_subtract = DSModelElementsSelection()  # "02.Select Solids to Subtract"; nothing selected; graph input
n04_family_method_one_family = BoolSelector(true)  # "04.Family Method : One Family ?"; graph input
n09_family_method_sequence_naming = BoolSelector(true)  # "09.Family Method : Sequence Naming Mode : True = Auto | False = Manual"; graph input
n08_family_method_family_name = StringInput("Dynamo Solid or Void Family")  # "08.Family Method : Family Name"; graph input
n10_family_method_start_sequence = DoubleInput(1)  # "10.Family Method : Start Sequence (Naming Suffix) - Manual Mode"; graph input
n14_family_method_category = Categories("OST_GenericModel")  # "14.Family Method : Category"; graph input
n16_family_method_family_template = Filename("..\..\..\..\..\..\..\..\..\..\ProgramData\Autodesk\RVT 2020\Family Templates\English\Metric Generic Model.rft")  # "16.Family Method : Family Template of The Above Category"; graph input
n06_family_method_is_shared = BoolSelector(false)  # "06.Family Method : Is Shared Family ?"; graph input
n07_family_method_to_void = BoolSelector(false)  # "07.Family Method : To Void ?"; graph input
n11_family_method_material = StringInput("")  # "11.Family Method : Material"; graph input
n13_family_method_material_single = BoolSelector(true)  # "13.Family Method : Material: Single Parameter Only ?"; graph input
n12_family_method_material_is = BoolSelector(true)  # "12.Family Method : Material: Is Instance Parameter ?"; graph input
n15_family_method_subcategory = StringInput("")  # "15.Family Method : Subcategory"; graph input
n05_family_method_self_origin = BoolSelector(true)  # "05.Family Method : Self Origin?"; graph input
n03_method_false_import_symbol = BoolSelector(true)  # "03.Method : False = Import Symbol | True = Family"; graph input

element_geometry_fixer = Custom[Element.Geometry Fixer](VARElement=n01_select_biggest_solid)  # package Synthesize toolkit; Element.Geometry Fixer
code_block = CodeBlock { "Solid"; }
byClassName = Custom[SP.Filter.ByClassName](VARobject=element_geometry_fixer, VARclassName=code_block)  # package Synthesize toolkit; Filters a list of objects by the object's class name. Note that Dynamo elements belong to different classes than their Revit counterparts. Use the Object.Class node to check an object's class.
flatten = List.Flatten(list=byClassName.VARin)
byUnion = Solid.ByUnion(solids=flatten)
element_geometry_fixer_2 = Custom[Element.Geometry Fixer](VARElement=n02_select_solids_to_subtract)
flatten_2 = List.Flatten(list=element_geometry_fixer_2)
code_block_2 = CodeBlock { "Solid"; }
byClassName_2 = Custom[SP.Filter.ByClassName](VARobject=flatten_2, VARclassName=code_block_2)
create = List.Create(item0=byClassName.VARin, item1=byClassName_2.VARin)
byUnion_2 = Solid.ByUnion(solids=create)
differenceAll = Solid.DifferenceAll(solid=byUnion, others=byUnion_2, lacing=Longest)
area = Solid.Area(solid=differenceAll)
code_block_3 = CodeBlock { 0; }
eq = area == code_block_3
filterByBoolMask = List.FilterByBoolMask(list=differenceAll, mask=eq)
code_block_4 = CodeBlock { false; }
clean = List.Clean(list=filterByBoolMask.out, preserveIndices=code_block_4)
flatten_3 = List.Flatten(list=clean)
code_block_5 = CodeBlock { true; }
ne = code_block_5 != n03_method_false_import_symbol
k_family_insert = Custom[K-Family Insert](VARGeometryorSAT=flatten_3, VAROneFamily=n04_family_method_one_family, VARAvoidConfilct=n09_family_method_sequence_naming, VARFamilyName=n08_family_method_family_name, VARFamilyNumber=n10_family_method_start_sequence, VARFamilyCategory=n14_family_method_category, VARFamilyTemplatePath=n16_family_method_family_template, VARIsShared=n06_family_method_is_shared, VARToVoid=n07_family_method_to_void, VARMaterialName=n11_family_method_material, VARIsOneMaterial=n13_family_method_material_single, VARIsMaterialInstance=n12_family_method_material_is, VARSubcategory=n15_family_method_subcategory, VARSelfOrigin=n05_family_method_self_origin, VARImportInstanceInstead=ne)  # package Synthesize toolkit; K-Family Insert
flatten_4 = List.Flatten(list=k_family_insert.VARFamilyInstancesOrImportSymbols)
generate_selection_filter = Custom[Generate Selection Filter](VARCreateSelectionFilter=n17_create_selection_filter, VARFilterNametoCreate=n18_filter_name_to_create, VAROverwriteExistingFilter=n19_overwrite_existing_filter, VARElements=flatten_4)  # package Synthesize toolkit; Generate Selection FIlter
debug_python_no_message = Custom[Debug Python No Message]()  # package Synthesize toolkit; Debug Python
