# Dynamo graph Family.Generate (Import Symbol or Family) By Surfaces Join.dyn (Dynamo 2.13.1.3887)
# author: karam@aecedx.com
# packages: Synthesize toolkit 12.5.1

# group: Input
n15_create_selection_filter = BoolSelector(true)  # "15.Create Selection Filter ?"; graph input
n16_filter_name_to_create = StringInput("Dynamo Generated Import Symbol or Family")  # "16.Filter Name to Create"; graph input
n17_overwrite_existing_filter = BoolSelector(false)  # "17.Overwrite Existing Filter ? (False for Adding Elements)"; graph input
n01_select_surfaces = SelectFaces()  # "01.Select Surfaces"; nothing selected; graph input
n03_family_method_one_family = BoolSelector(true)  # "03.Family Method : One Family ?"; graph input
n07_family_method_sequence_naming = BoolSelector(true)  # "07.Family Method : Sequence Naming Mode : True = Auto | False = Manual"; graph input
n06_family_method_family_name = StringInput("Dynamo Solid or Void Family")  # "06.Family Method : Family Name"; graph input
n08_family_method_start_sequence = DoubleInput(1)  # "08.Family Method : Start Sequence (Naming Suffix) - Manual Mode"; graph input
n12_family_method_category = Categories("OST_GenericModel")  # "12.Family Method : Category"; graph input
n14_family_method_family_template = Filename("..\..\..\..\..\..\..\..\..\..\ProgramData\Autodesk\RVT 2020\Family Templates\English\Metric Generic Model.rft")  # "14.Family Method : Family Template of The Above Category"; graph input
n05_family_method_is_shared = BoolSelector(false)  # "05.Family Method : Is Shared Family ?"; graph input
n09_family_method_material = StringInput("")  # "09.Family Method : Material"; graph input
n11_family_method_material_single = BoolSelector(true)  # "11.Family Method : Material: Single Parameter Only ?"; graph input
n10_family_method_material_is = BoolSelector(true)  # "10.Family Method : Material: Is Instance Parameter ?"; graph input
n13_family_method_subcategory = StringInput("")  # "13.Family Method : Subcategory"; graph input
n04_family_method_self_origin = BoolSelector(true)  # "04.Family Method : Self Origin ?"; graph input
n02_method_false_import_symbol = BoolSelector(true)  # "02.Method : False = Import Symbol | True = Family"; graph input

flatten = List.Flatten(list=n01_select_surfaces)
join_adjacent_surfaces = Custom[Join Adjacent Surfaces](VARSurfaces=flatten)  # package Synthesize toolkit; Join Adjacent Surfaces
flatten_2 = List.Flatten(list=join_adjacent_surfaces)
code_block = CodeBlock { true; }
ne = code_block != n02_method_false_import_symbol
k_family_insert = Custom[K-Family Insert](VARGeometryorSAT=flatten_2, VAROneFamily=n03_family_method_one_family, VARAvoidConfilct=n07_family_method_sequence_naming, VARFamilyName=n06_family_method_family_name, VARFamilyNumber=n08_family_method_start_sequence, VARFamilyCategory=n12_family_method_category, VARFamilyTemplatePath=n14_family_method_family_template, VARIsShared=n05_family_method_is_shared, VARMaterialName=n09_family_method_material, VARIsOneMaterial=n11_family_method_material_single, VARIsMaterialInstance=n10_family_method_material_is, VARSubcategory=n13_family_method_subcategory, VARSelfOrigin=n04_family_method_self_origin, VARImportInstanceInstead=ne)  # package Synthesize toolkit; K-Family Insert
flatten_3 = List.Flatten(list=k_family_insert.VARFamilyInstancesOrImportSymbols)
generate_selection_filter = Custom[Generate Selection Filter](VARCreateSelectionFilter=n15_create_selection_filter, VARFilterNametoCreate=n16_filter_name_to_create, VAROverwriteExistingFilter=n17_overwrite_existing_filter, VARElements=flatten_3)  # package Synthesize toolkit; Generate Selection FIlter
debug_python_no_message = Custom[Debug Python No Message]()  # package Synthesize toolkit; Debug Python
