# Dynamo graph Family.Generate (Import Symbol or Family) By Surfaces Offset.dyn (Dynamo 2.13.1.3887)
# author: karam@aecedx.com
# packages: Synthesize toolkit 12.5.1

# group: Input
n19_create_selection_filter = BoolSelector(true)  # "19.Create Selection Filter ?"; graph input
n20_filter_name_to_create = StringInput("Dynamo Generated Import Symbol or Family")  # "20.Filter Name to Create"; graph input
n21_overwrite_existing_filter = BoolSelector(false)  # "21.Overwrite Existing Filter ? (False for Adding Elements)"; graph input
n01_select_surfaces = SelectFaces()  # "01.Select Surfaces"; nothing selected; graph input
n03_surfaces_offset = DoubleInput(2)  # "03.Surfaces Offset"; graph input
n02_join_adjacent_surfaces = BoolSelector(false)  # "02.Join Adjacent Surfaces ?"; graph input
n04_borders_inner_offset = DoubleInput(0)  # "04.Borders Inner Offset"; graph input
n06_family_method_one_family = BoolSelector(true)  # "06.Family Method : One Family ?"; graph input
n11_family_method_sequence_naming = BoolSelector(true)  # "11.Family Method : Sequence Naming Mode : True = Auto | False = Manual"; graph input
n10_family_method_family_name = StringInput("Dynamo Solid or Void Family")  # "10.Family Method : Family Name"; graph input
n12_family_method_start_sequence = DoubleInput(1)  # "12.Family Method : Start Sequence (Naming Suffix) - Manual Mode"; graph input
n16_family_method_category = Categories("OST_GenericModel")  # "16.Family Method : Category"; graph input
n18_family_method_family_template = Filename("..\..\..\..\..\..\..\..\..\..\ProgramData\Autodesk\RVT 2020\Family Templates\English\Metric Generic Model.rft")  # "18.Family Method : Family Template of The Above Category"; graph input
n08_family_method_is_shared = BoolSelector(false)  # "08.Family Method : Is Shared Family ?"; graph input
n09_family_method_to_void = BoolSelector(false)  # "09.Family Method : To Void ?"; graph input
n13_family_method_material = StringInput("")  # "13.Family Method : Material"; graph input
n15_family_method_material_single = BoolSelector(true)  # "15.Family Method : Material: Single Parameter Only ?"; graph input
n14_family_method_material_is = BoolSelector(true)  # "14.Family Method : Material: Is Instance Parameter ?"; graph input
n17_family_method_subcategory = StringInput("")  # "17.Family Method : Subcategory"; graph input
n07_family_method_self_origin = BoolSelector(true)  # "07.Family Method : Self Origin ?"; graph input
n05_method_false_import_symbol = BoolSelector(true)  # "05.Method : False = Import Symbol | True = Family"; graph input

surface_importer = Custom[Surface Importer](VARSurfaces=n01_select_surfaces)  # package Synthesize toolkit; Surface Importer Node
surfaces = PolySurface.Surfaces(polySurface=surface_importer)
flatten = List.Flatten(list=surfaces)
smart_surface_offset = Custom[Smart Surface Offset](VARSurfaces=flatten, VARDistances=n03_surfaces_offset, VARJoinAdjacentSurfaces=n02_join_adjacent_surfaces)  # package Synthesize toolkit; Smart Surface Offset
code_block = CodeBlock { true; }
surfaces_border_offset = Custom[Surfaces Border Offset](VARSurfaces=smart_surface_offset, VAROffset=n04_borders_inner_offset, VARKeepFrame=code_block)  # package Synthesize toolkit; Surfaces Border Offset
join_adjacent_surfaces = Custom[Join Adjacent Surfaces](VARSurfaces=surfaces_border_offset.VARExtraFrameOnly, VARJoinOrNot=n02_join_adjacent_surfaces)  # package Synthesize toolkit; Join Adjacent Surfaces
join_adjacent_surfaces_2 = Custom[Join Adjacent Surfaces](VARSurfaces=surfaces_border_offset.VARFrameSolids, VARJoinOrNot=n02_join_adjacent_surfaces)
create = List.Create(item0=join_adjacent_surfaces, item1=join_adjacent_surfaces_2)
code_block_2 = CodeBlock { false; }
clean = List.Clean(list=create, preserveIndices=code_block_2)
flatten_2 = List.Flatten(list=clean)
code_block_3 = CodeBlock { true; }
ne = n05_method_false_import_symbol != code_block_3
k_family_insert = Custom[K-Family Insert](VARGeometryorSAT=flatten_2, VAROneFamily=n06_family_method_one_family, VARAvoidConfilct=n11_family_method_sequence_naming, VARFamilyName=n10_family_method_family_name, VARFamilyNumber=n12_family_method_start_sequence, VARFamilyCategory=n16_family_method_category, VARFamilyTemplatePath=n18_family_method_family_template, VARIsShared=n08_family_method_is_shared, VARToVoid=n09_family_method_to_void, VARMaterialName=n13_family_method_material, VARIsOneMaterial=n15_family_method_material_single, VARIsMaterialInstance=n14_family_method_material_is, VARSubcategory=n17_family_method_subcategory, VARSelfOrigin=n07_family_method_self_origin, VARImportInstanceInstead=ne)  # package Synthesize toolkit; K-Family Insert
flatten_3 = List.Flatten(list=k_family_insert.VARFamilyInstancesOrImportSymbols)
generate_selection_filter = Custom[Generate Selection Filter](VARCreateSelectionFilter=n19_create_selection_filter, VARFilterNametoCreate=n20_filter_name_to_create, VAROverwriteExistingFilter=n21_overwrite_existing_filter, VARElements=flatten_3)  # package Synthesize toolkit; Generate Selection FIlter
debug_python = Custom[Debug Python]()  # package Synthesize toolkit; Debug Python
