# Dynamo graph Family.Generate Revit Free Form By All Elements of Active View (Union).dyn (Dynamo 2.13.1.3887)
# author: karam@aecedx.com
# packages: Synthesize toolkit 12.5.1

debug_python_no_message = Custom[Debug Python No Message]()  # package Synthesize toolkit; Debug Python
current = Document.Current()
isFamilyDocument = Document.IsFamilyDocument(document=current)
empty = List.Empty()
python_all_elements_in_active = Custom[Python All Elements In Active View]()  # package Synthesize toolkit; Python All Elements In Active View
element_geometry_fast = Custom[Element.Geometry Fast](VARElements=python_all_elements_in_active)  # package Synthesize toolkit; Element.Geometry Fast
flatten = List.Flatten(list=element_geometry_fast)
code_block = CodeBlock { "Solid"; "Surface"; }
byClassName = Custom[SP.Filter.ByClassName](VARobject=flatten, VARclassName=code_block.out0)  # package Synthesize toolkit; Filters a list of objects by the object's class name. Note that Dynamo elements belong to different classes than their Revit counterparts. Use the Object.Class node to check an object's class.
byClassName_2 = Custom[SP.Filter.ByClassName](VARobject=byClassName.VARout, VARclassName=code_block.out1)

# group: Input
n01_union_solids = BoolSelector(true)  # "01.Union Solids ?"; graph input
n05_one_family_in_project = BoolSelector(true)  # "05.One Family ? (In Project Environment)"; graph input
n04_family_name_in_project = StringInput("Dynamo Free Form Family")  # "04.Family Name (In Project Environment)"; graph input
n06_category_in_project = Categories("OST_Mass")  # "06.Category (In Project Environment)"; graph input
n07_family_template_of_the_above = Filename("..\..\..\..\..\..\..\..\..\..\ProgramData\Autodesk\RVT 2020\Family Templates\English\Conceptual Mass\Metric Mass.rft")  # "07.Family Template of The Above Category (In Project Environment)"; graph input
n02_void = BoolSelector(false)  # "02.Void ?"; graph input
n03_material_to_set = StringInput("Default Transparent")  # "03.Material to Set"; graph input

empty_2 = List.Empty()
scopeIf = Custom[CW.ScopeIf+](VARtest=n01_union_solids, VARtrue=byClassName.VARin, VARfalse=empty_2)  # package Synthesize toolkit; A (hopefully) more robust implementation of ScopeIf. Tests a single boolean and returns a value accordingly.
byUnion = Custom[CW.Solid.ByUnion+](VARsolids=scopeIf)  # package Synthesize toolkit; The OOTB node Solid.ByUnion occasionally fails when trying to merge solids with almost adjacent faces. This node will return the minimum amount of joined solids possible in such cases instead of returning null.
scopeIf_2 = Custom[CW.ScopeIf+](VARtest=n01_union_solids, VARtrue=byUnion, VARfalse=byClassName.VARin)
create = List.Create(item0=byClassName_2.VARin, item1=scopeIf_2)
code_block_2 = CodeBlock { false; }
clean = List.Clean(list=create, preserveIndices=code_block_2)
flatten_2 = List.Flatten(list=clean)
scopeIf_3 = Custom[CW.ScopeIf+](VARtest=isFamilyDocument, VARtrue=empty, VARfalse=flatten_2)
smart_rft_path = Custom[Smart RFT Path](VARRFTFile=n07_family_template_of_the_above, VARCategory=n06_category_in_project)  # package Synthesize toolkit; Smart RFT Path
code_block_3 = CodeBlock { false; }
k_family_insert = Custom[K-Family Insert](VARGeometryorSAT=scopeIf_3, VAROneFamily=n05_one_family_in_project, VARFamilyName=n04_family_name_in_project, VARFamilyCategory=n06_category_in_project, VARFamilyTemplatePath=smart_rft_path, VARToVoid=n02_void, VARMaterialName=n03_material_to_set, VARSelfOrigin=code_block_3)  # package Synthesize toolkit; K-Family Insert
scopeIf_4 = Custom[CW.ScopeIf+](VARtest=isFamilyDocument, VARtrue=flatten_2, VARfalse=empty)
code_block_4 = CodeBlock { "Free Form - Unioned"; "Free Form"; }
scopeIf_5 = Custom[CW.ScopeIf+](VARtest=n01_union_solids, VARtrue=code_block_4.out0, VARfalse=code_block_4.out1)
dynamo_geometry_to_revit = Custom[Dynamo Geometry To Revit Compatibility](VARGeometryOrSat=scopeIf_4, VARToVoid=n02_void, VARMaterialName=n03_material_to_set, VARSubcategory=scopeIf_5)  # package Synthesize toolkit; Dynamo Geometry To Revit Compatibility
try_to_hide_elements_in_mass = Custom[Try to Hide Elements In Mass Only](VARElements=python_all_elements_in_active, VARWait=dynamo_geometry_to_revit)  # package Synthesize toolkit; Try to Hide Elements
