# Dynamo graph Family.Generate Voider By Surface Selection.dyn (Dynamo 2.13.1.3887)
# author: karam@aecedx.com
# packages: Synthesize toolkit 12.5.1

# group: Input
thickness = DoubleInput(3)  # "04.Thickness"; graph input
n06_borders_outer_offset_ratio_0 = DoubleSlider(0.1, range=0..1 step 0.01)  # "06.Borders Outer Offset Ratio (0-1)"; graph input
n01_select_faces = SelectFaces()  # "01.Select Faces"; nothing selected; graph input
n07_borders_inner_offset = DoubleInput(0)  # "07.Borders Inner Offset"; graph input
n03_full_body = BoolSelector(false)  # "03.Full Body ?"; graph input
n05_thicken_both_sides = BoolSelector(true)  # "05.Thicken Both Sides ?"; graph input
n08_family_name = StringInput("Dynamo Smart Voider")  # "08.Family Name"; graph input
category = Categories("OST_GenericModel")  # "09.Category"; graph input
n10_family_template_of_the_above = Filename("..\..\..\..\..\..\..\..\..\..\ProgramData\Autodesk\RVT 2020\Family Templates\English\Metric Generic Model.rft")  # "10.Family Template of The Above Category"; graph input
n02_generate_void_false_to = BoolSelector(true)  # "02.Generate Void ? (False to Generate Solid)"; graph input

surfaces_border_offset = Custom[Surfaces Border Offset](VARSurfaces=n01_select_faces, VAROffset=n07_borders_inner_offset)  # package Synthesize toolkit; Surfaces Border Offset
patterns_voider_generator = Custom[Patterns Voider Generator](VARThickness=thickness, VARFaceExtendRatio0To1=n06_borders_outer_offset_ratio_0, VARSurfaces=surfaces_border_offset.VARExtraFrameOnly, VARFullFace=n03_full_body, VARThickenBothSides=n05_thicken_both_sides)  # package Synthesize toolkit; Patterns Voider Generator
code_block = CodeBlock { false; }
k_family_insert = Custom[K-Family Insert](VARGeometryorSAT=patterns_voider_generator, VAROneFamily=code_block, VARFamilyName=n08_family_name, VARFamilyCategory=category, VARFamilyTemplatePath=n10_family_template_of_the_above, VARToVoid=n02_generate_void_false_to)  # package Synthesize toolkit; K-Family Insert
code_block_2 = CodeBlock { true; }
setPinnedStatus = Custom[RH.Element.SetPinnedStatus](VARelement=k_family_insert.VARFamilyInstancesOrImportSymbols, VARBool=code_block_2)  # package Synthesize toolkit; Will set the element to either pinned or not pinned. True is pinned, false is unpinned. For multiple elements use List.Map
debug_python = Custom[Debug Python]()  # package Synthesize toolkit; Debug Python
