# Dynamo graph Family.K-Array By Levels With Curves Selection.dyn (Dynamo 2.13.1.3887)
# author: karam@aecedx.com
# packages: Synthesize toolkit 12.5.1

# group: Input
n22_number_of_elements_to_remove = DoubleInput(0)  # "22.Number of Elements to Remove after Array (Negative to Remove from the End)"; graph input
n23_remove_from_both_start_and = BoolSelector(false)  # "23.Remove from Both Start and End ?"; graph input
n19_minimum_random_rotation_angle = DoubleSlider(0, range=-360..360 step 1)  # "19.Minimum Random Rotation Angle (Useful When Randomize Rotations is Activated)"; graph input
n20_maximum_random_rotation_angle = DoubleSlider(360, range=-360..360 step 1)  # "20.Maximum Random Rotation Angle (Useful When Randomize Rotations is Activated)"; graph input
n18_randomize_rotations = BoolSelector(false)  # "18.Randomize Rotations ?"; graph input
n16_random_types_placement = BoolSelector(false)  # "16.Random Types Placement ?"; graph input
n17_rotation_angle_to_add_can_be = DoubleInput(0)  # "17.Rotation Angle to Add (Can be 0)"; graph input
n05_by_distance_false_by_number = BoolSelector(false)  # "05.By Distance = False | By Number = True"; graph input
n11_by_distance_start_offset = DoubleInput(0)  # "11.By Distance : Start Offset"; graph input
n06_by_distance_distances = DoubleInput(2)  # "06.By Distance : Distances"; graph input
n13_by_number_start_ratio = DoubleSlider(0, range=0..1 step 0.01)  # "13.By Number : Start Ratio"; graph input
n14_by_number_end_ratio = DoubleSlider(1, range=0..1 step 0.01)  # "14.By Number : End Ratio"; graph input
n07_by_distance_center = BoolSelector(false)  # "07.By Distance : Center Justification"; graph input
n15_by_number_position = DoubleSlider(0, range=0..1 step 0.01)  # "15.By Number : Position Justification (0 to 1)"; graph input
n12_by_number_number_of_items = DoubleInput(15)  # "12.By Number : Number of Items"; graph input
n04_offset_closed_loops = DoubleInput(0)  # "04.Offset (Closed Loops Recommended)"; graph input
n21_reverse_array_direction = BoolSelector(false)  # "21.Reverse Array Direction"; graph input
n03_select_path_s = DSModelElementsSelection()  # "03.Select Path(s)"; nothing selected; graph input
n08_by_distance_justify_each_line = BoolSelector(false)  # "08.By Distance : Justify Each Line Separately"; graph input
n09_by_distance_force_start = BoolSelector(false)  # "09.By Distance : Force Start ?"; graph input
n10_by_distance_force_end = BoolSelector(false)  # "10.By Distance : Force End ?"; graph input
n24_create_selection_filter = BoolSelector(true)  # "24.Create Selection Filter ?"; graph input
n25_filter_name_to_create = StringInput("Dynamo K-Array By Levels")  # "25.Filter Name to Create"; graph input
n26_overwrite_existing_filter = BoolSelector(false)  # "26.Overwrite Existing Filter ? (False for Adding Elements)"; graph input

disable_rotations = BoolSelector(false)
fix_factor_depends_of_project = DoubleInput(1000)  # "Fix Factor (Depends of Project Units, 1 For meters for example, and 100 for Centimeters)"

# group: You can add more types
n01_family_type_1 = FamilyTypes()  # "01.Family Type 1"; nothing selected; graph input
n02_family_type_2 = FamilyTypes()  # "02.Family Type 2"; nothing selected; graph input
create = List.Create(item0=n01_family_type_1, item1=n02_family_type_2)

python_script = Python(IN[0]=create)  # IronPython2
# ---------- python_script.python (82 lines) ----------
# Created By Karam Baki : karam@aecedx.com
# Enable Python support and load DesignScript library
# IMPORTANT : ALL DYNAMO DESIGN SCRIPT NODES ARE AS (dg)
import clr
clr.AddReference('ProtoGeometry')
from Autodesk.DesignScript import Geometry as dg

# EXTENSION Enable ToDSType
clr.AddReference('RevitNodes')
import Revit
clr.ImportExtensions(Revit.Elements)

# Enable Revit Elements
from Revit.Elements import *

# EXTENSION Enable Geometry Conversion Methods
clr.ImportExtensions(Revit.GeometryConversion)

# Enable Revit API
clr.AddReference('RevitAPI')
from Autodesk.Revit.DB import *
from Autodesk.Revit.DB.Architecture import *
# Enable DocumentManager and TransactionManager
clr.AddReference('RevitServices')
from RevitServices.Persistence import DocumentManager
from RevitServices.Transactions import TransactionManager

# Enable ICollection List Translate
clr.AddReference("System")
import System.Collections.Generic
from System.Collections.Generic import List

from Autodesk.Revit.DB.Structure import StructuralType

clr.AddReference("RevitAPIUI")
from Autodesk.Revit.UI import TaskDialog

title = "AECedx - Karam"

# Choose The Current Document
doc = DocumentManager.Instance.CurrentDBDocument
uidoc = DocumentManager.Instance.CurrentUIApplication.ActiveUIDocument
uiapp = DocumentManager.Instance.CurrentUIApplication
app = uiapp.Application

famtypes = UnwrapElement(IN[0])

def isworkplane(famtype):
	if not famtype.IsActive: famtype.Activate()
	try:
		test = doc.Create.NewFamilyInstance(XYZ(0,0,0), famtype, StructuralType.NonStructural)
		eachparams = test.GetOrderedParameters()
		workplanebased = False
		for epms in eachparams:
			pname = epms.Definition.Name
			if pname == "Work Plane":
					workplanebased = True
		doc.Delete(test.Id)
	except:
		workplanebased = False
	
	return workplanebased

TransactionManager.Instance.EnsureInTransaction(doc)
workplaneslist = []
for famtype in famtypes:
	if isworkplane(famtype) == True:
		workplaneslist.append(famtype.FamilyName + " (Is Workplane Based)")
TransactionManager.Instance.TransactionTaskDone()

temp_list = []
for i in workplaneslist:
    if i not in temp_list:
        temp_list.append(i)
workplaneslist = temp_list

if len(workplaneslist) > 0:
	workplaneslist.Insert(0,"Please Use K-Array By Workplanes With:")
	msg = "\n".join(workplaneslist)
	OUT = TaskDialog.Show(title, msg)
else:
	OUT = famtypes
# ----------------------------------------
curves = Element.Curves(element=n03_select_path_s)
k_array_by_levels = Custom[K-Array By Levels](VARNumberofElementstoRemoveafterArrayNegativetoRemovefromtheEnd=n22_number_of_elements_to_remove, VARRemovefromBothStartandEnd=n23_remove_from_both_start_and, VARDisableRotations=disable_rotations, VARMinimumRandomRotationAngleUsefulWhenRandomizeRotationsisActivated=n19_minimum_random_rotation_angle, VARMaximumRandomRotationAngleUsefulWhenRandomizeRotationsisActivated=n20_maximum_random_rotation_angle, VARRandomizeRotations=n18_randomize_rotations, VARFixFactorDependsofProjectUnits1Formetersforexampleand100forCentimeters=fix_factor_depends_of_project, VARRandomTypesPlacement=n16_random_types_placement, VARRotationAngletoAddCanbe0=n17_rotation_angle_to_add_can_be, VARFamilyTypesList=python_script, VARByDistance=n05_by_distance_false_by_number, VARByDistanceStartOffset=n11_by_distance_start_offset, VARByDistanceDistances=n06_by_distance_distances, VARByNumberStartRatio=n13_by_number_start_ratio, VARByNumberEndRatio=n14_by_number_end_ratio, VARByDistanceCenterJustification=n07_by_distance_center, VARByNumberPositionJustification0to1=n15_by_number_position, VARByNumberNumberofItems=n12_by_number_number_of_items, VAROffsetClosedLoopsRecommended=n04_offset_closed_loops, VARReverseArrayDirection=n21_reverse_array_direction, VARCurves=curves, VARByDistanceJustifyEachLineSeparately=n08_by_distance_justify_each_line, VARByDistanceForceStart=n09_by_distance_force_start, VARByDistanceForceEnd=n10_by_distance_force_end)  # package Synthesize toolkit; K-Array By Levels

# group: Report
n01_spaces_report = Watch(k_array_by_levels.VARSpacesReport)  # "01.Spaces Report"; graph output
n02_number_of_families_placed_per = Watch(k_array_by_levels.VARNumberofFamiliesPlacedPerPath)  # "02.Number of Families Placed Per Path"; graph output
n03_total_families_placed = Watch(k_array_by_levels.VARTotalFamiliesPlaced)  # "03.Total Families Placed"; graph output

removeListFromList = Custom[RH.RemoveListFromList](VARListA=k_array_by_levels.VARElements, VARListB=k_array_by_levels.VARElementstoErase)  # package Synthesize toolkit; This node essentially "subtracts" the contents of List B from List A to produce a new list with the unique items.
generate_selection_filter = Custom[Generate Selection Filter](VARCreateSelectionFilter=n24_create_selection_filter, VARFilterNametoCreate=n25_filter_name_to_create, VAROverwriteExistingFilter=n26_overwrite_existing_filter, VARElements=removeListFromList)  # package Synthesize toolkit; Generate Selection FIlter
eraser = Custom[ST.Tool.Eraser](VARList=k_array_by_levels.VARElementstoErase)  # package Synthesize toolkit; Try to delete any element from project
debug_python = Custom[Debug Python]()  # package Synthesize toolkit; Debug Python
