# Dynamo graph Family.K-Array By Workplanes With Curves Selection.dyn (Dynamo 2.13.1.3887)
# author: karam@aecedx.com
# packages: Synthesize toolkit 12.5.1

# group: Input
n23_number_of_elements_to_remove = DoubleInput(0)  # "23.Number of Elements to Remove after Array (Negative to Remove from the End)"; graph input
n24_remove_from_both_start_and = BoolSelector(false)  # "24.Remove from Both Start and End ?"; graph input
n19_randomize_rotations = BoolSelector(false)  # "19.Randomize Rotations ?"; graph input
n18_rotation_angle_to_add_can_be = DoubleInput(0)  # "18.Rotation Angle to Add (Can be 0)"; graph input
n20_minimum_random_rotation_angle = DoubleSlider(0, range=-360..360 step 1)  # "20.Minimum Random Rotation Angle (Useful When Randomize Rotations is Activated)"; graph input
n21_maximum_random_rotation_angle = DoubleSlider(360, range=-360..360 step 1)  # "21.Maximum Random Rotation Angle (Useful When Randomize Rotations is Activated)"; graph input
n04_select_faces = SelectFaces()  # "04.Select Faces"; nothing selected; graph input
n17_random_types_placement = BoolSelector(false)  # "17.Random Types Placement ?"; graph input
n06_by_distance_false_by_number = BoolSelector(false)  # "06.By Distance = False | By Number = True"; graph input
n08_by_distance_center = BoolSelector(false)  # "08.By Distance : Center Justification"; graph input
n14_by_number_start_ratio = DoubleSlider(0, range=0..1 step 0.01)  # "14.By Number : Start Ratio"; graph input
n15_by_number_end_ratio = DoubleSlider(1, range=0..1 step 0.01)  # "15.By Number : End Ratio"; graph input
n07_by_distance_distances = DoubleInput(2)  # "07.By Distance : Distances"; graph input
n16_by_number_position = DoubleSlider(0, range=0..1 step 0.01)  # "16.By Number : Position Justification (0 to 1)"; graph input
n12_by_distance_start_offset = DoubleInput(0)  # "12.By Distance : Start Offset"; graph input
n13_by_number_number_of_items = DoubleInput(15)  # "13.By Number : Number of Items"; graph input
n05_offset_closed_loops = DoubleInput(0)  # "05.Offset (Closed Loops Recommended)"; graph input
n22_reverse_array_direction = BoolSelector(false)  # "22.Reverse Array Direction"; graph input
n03_select_path_s = DSModelElementsSelection()  # "03.Select Path(s)"; nothing selected; graph input
n09_by_distance_justify_each_line = BoolSelector(false)  # "09.By Distance : Justify Each Line Separately"; graph input
n10_by_distance_force_start = BoolSelector(false)  # "10.By Distance : Force Start ?"; graph input
n11_by_distance_force_end = BoolSelector(false)  # "11.By Distance : Force End ?"; graph input
n25_create_selection_filter = BoolSelector(true)  # "25.Create Selection Filter ?"; graph input
n26_filter_name_to_create = StringInput("Dynamo K-Array By Workplanes")  # "26.Filter Name to Create"; graph input
n27_overwrite_existing_filter = BoolSelector(false)  # "27.Overwrite Existing Filter ? (False for Adding Elements)"; graph input

# group: You can add more types
n01_family_type_1 = FamilyTypes("M_Desk:1525 x 762mm")  # "01.Family Type 1"; graph input
n02_family_type_2 = FamilyTypes("M_Desk:1525 x 762mm")  # "02.Family Type 2"; graph input
create = List.Create(item0=n01_family_type_1, item1=n02_family_type_2)

curves = Element.Curves(element=n03_select_path_s)
k_array_by_workplanes = Custom[K-Array By Workplanes](VARNumberofElementstoRemoveafterArrayNegativetoRemovefromtheEnd=n23_number_of_elements_to_remove, VARRemovefromBothStartandEnd=n24_remove_from_both_start_and, VARRandomizeRotations=n19_randomize_rotations, VARRotationAngletoAddCanbe0=n18_rotation_angle_to_add_can_be, VARMinimumRandomRotationAngleUsefulWhenRandomizeRotationsisActivated=n20_minimum_random_rotation_angle, VARMaximumRandomRotationAngleUsefulWhenRandomizeRotationsisActivated=n21_maximum_random_rotation_angle, VARSelectFaces=n04_select_faces, VARRandomTypesPlacement=n17_random_types_placement, VARFamilyTypesList=create, VARByDistance=n06_by_distance_false_by_number, VARByDistanceCenterJustification=n08_by_distance_center, VARByNumberStartRatio=n14_by_number_start_ratio, VARByNumberEndRatio=n15_by_number_end_ratio, VARByDistanceDistances=n07_by_distance_distances, VARByNumberPositionJustification0to1=n16_by_number_position, VARByDistanceStartOffset=n12_by_distance_start_offset, VARByNumberNumberofItems=n13_by_number_number_of_items, VAROffsetClosedLoopsRecommended=n05_offset_closed_loops, VARReverseArrayDirection=n22_reverse_array_direction, VARCurves=curves, VARByDistanceJustifyEachLineSeparately=n09_by_distance_justify_each_line, VARByDistanceForceStart=n10_by_distance_force_start, VARByDistanceForceEnd=n11_by_distance_force_end)  # package Synthesize toolkit; K-Array By Workplanes

# group: Report
n01_spaces_report = Watch(k_array_by_workplanes.VARSpaceReport)  # "01.Spaces Report"; graph output
n02_number_of_families_placed_per = Watch(k_array_by_workplanes.VARNumberofFamiliesPlacedPerPath)  # "02.Number of Families Placed Per Path"; graph output
n03_total_families_placed = Watch(k_array_by_workplanes.VARTotalFamiliesPlaced)  # "03.Total Families Placed"; graph output

removeListFromList = Custom[RH.RemoveListFromList](VARListA=k_array_by_workplanes.VARElements, VARListB=k_array_by_workplanes.VARElementstoErase)  # package Synthesize toolkit; This node essentially "subtracts" the contents of List B from List A to produce a new list with the unique items.
generate_selection_filter = Custom[Generate Selection Filter](VARCreateSelectionFilter=n25_create_selection_filter, VARFilterNametoCreate=n26_filter_name_to_create, VAROverwriteExistingFilter=n27_overwrite_existing_filter, VARElements=removeListFromList)  # package Synthesize toolkit; Generate Selection FIlter
eraser = Custom[ST.Tool.Eraser](VARList=k_array_by_workplanes.VARElementstoErase)  # package Synthesize toolkit; Try to delete any element from project
debug_python = Custom[Debug Python]()  # package Synthesize toolkit; Debug Python
