# Dynamo graph Family.K-Array By Workplanes With Organic Face and Curves Selection.dyn (Dynamo 2.13.1.3887)
# author: karam@aecedx.com
# packages: Synthesize toolkit 12.5.1

# group: Input
n22_number_of_elements_to_remove = DoubleInput(0)  # "22.Number of Elements to Remove after Array (Negative to Remove from the End)"; graph input
n23_remove_from_both_start_and = BoolSelector(false)  # "23.Remove from Both Start and End ?"; graph input
n19_minimum_random_rotation_angle = DoubleSlider(0, range=-360..360 step 1)  # "19.Minimum Random Rotation Angle (Useful When Randomize Rotations is Activated)"; graph input
n20_maximum_random_rotation_angle = DoubleSlider(360, range=-360..360 step 1)  # "20.Maximum Random Rotation Angle (Useful When Randomize Rotations is Activated)"; graph input
n18_randomize_rotations = BoolSelector(false)  # "18.Randomize Rotations ?"; graph input
n17_rotation_angle_to_add_can_be = DoubleInput(0)  # "17.Rotation Angle to Add (Can be 0)"; graph input
n16_random_types_placement = BoolSelector(false)  # "16.Random Types Placement ?"; graph input
n05_by_distance_false_by_number = BoolSelector(false)  # "05.By Distance = False | By Number = True"; graph input
n07_by_distance_center = BoolSelector(false)  # "07.By Distance : Center Justification"; graph input
n13_by_number_start_ratio = DoubleSlider(0, range=0..1 step 0.01)  # "13.By Number : Start Ratio"; graph input
n14_by_number_end_ratio = DoubleSlider(1, range=0..1 step 0.01)  # "14.By Number : End Ratio"; graph input
n15_by_number_position = DoubleSlider(0, range=0..1 step 0.01)  # "15.By Number : Position Justification (0 to 1)"; graph input
n21_reverse_array_direction = BoolSelector(false)  # "21.Reverse Array Direction"; graph input
n11_by_distance_start_offset = DoubleInput(0)  # "11.By Distance : Start Offset"; graph input
n06_by_distance_distances = DoubleInput(2)  # "06.By Distance : Distances"; graph input
n12_by_number_number_of_items = DoubleInput(15)  # "12.By Number : Number of Items"; graph input
offset = DoubleInput(0)  # "04.Offset"; graph input
n03_select_path_s = DSModelElementsSelection()  # "03.Select Path(s)"; nothing selected; graph input
n08_by_distance_justify_each_line = BoolSelector(false)  # "08.By Distance : Justify Each Line Separately"; graph input
n09_by_distance_force_start = BoolSelector(false)  # "09.By Distance : Force Start ?"; graph input
n10_by_distance_force_end = BoolSelector(false)  # "10.By Distance : Force End ?"; graph input
n24_create_selection_filter = BoolSelector(true)  # "24.Create Selection Filter ?"; graph input
n25_filter_name_to_create = StringInput("Dynamo K-Array By Workplanes")  # "25.Filter Name to Create"; graph input
n26_overwrite_existing_filter = BoolSelector(false)  # "26.Overwrite Existing Filter ? (False for Adding Elements)"; graph input

selectFaces = Custom[SP.SelectFaces+]()  # package Synthesize toolkit; Select multiple faces from inside the Revit UI. Be sure to press "Finish" once done. Unlike the built-in node, face references of instances will be added sucessfully and you'l get the pick points. You can use a Boolean toggle to refresh your selection.

# group: You can add more types
n01_family_type_1 = FamilyTypes("M_Desk:1525 x 762mm")  # "01.Family Type 1"; graph input
n02_family_type_2 = FamilyTypes("M_Desk:1525 x 762mm")  # "02.Family Type 2"; graph input
create = List.Create(item0=n01_family_type_1, item1=n02_family_type_2)

curves = Element.Curves(element=n03_select_path_s)
k_array_by_workplanes_organic = Custom[K-Array By Workplanes Organic](VARNumberofElementstoRemoveafterArrayNegativetoRemovefromtheEnd=n22_number_of_elements_to_remove, VARRemovefromBothStartandEnd=n23_remove_from_both_start_and, VARMinimumRandomRotationAngleUsefulWhenRandomizeRotationsisActivated=n19_minimum_random_rotation_angle, VARMaximumRandomRotationAngleUsefulWhenRandomizeRotationsisActivated=n20_maximum_random_rotation_angle, VARRandomizeRotations=n18_randomize_rotations, VARRotationAngletoAddCanbe0=n17_rotation_angle_to_add_can_be, VARSurfaces=selectFaces.VARfaces, VARFamilyTypesList=create, VARRandomTypesPlacement=n16_random_types_placement, VARByDistance=n05_by_distance_false_by_number, VARByDistanceCenterJustification=n07_by_distance_center, VARByNumberStartRatio=n13_by_number_start_ratio, VARByNumberEndRatio=n14_by_number_end_ratio, VARByNumberPositionJustification0to1=n15_by_number_position, VARReverseArrayDirection=n21_reverse_array_direction, VARPickPoints=selectFaces.VARpickPoints, VARByDistanceStartOffset=n11_by_distance_start_offset, VARByDistanceDistances=n06_by_distance_distances, VARByNumberNumberofItems=n12_by_number_number_of_items, VAROffset=offset, VARCurves=curves, VARByDistanceJustifyEachLineSeparately=n08_by_distance_justify_each_line, VARByDistanceForceStart=n09_by_distance_force_start, VARByDistanceForceEnd=n10_by_distance_force_end)  # package Synthesize toolkit; K-Array By Workplanes on Organic Faces

# group: Report
n01_spaces_report = Watch(k_array_by_workplanes_organic.VARSpacesReport)  # "01.Spaces Report"; graph output
n02_number_of_families_placed_per = Watch(k_array_by_workplanes_organic.VARNumberofFamiliesPlacedPerPath)  # "02.Number of Families Placed Per Path"; graph output
n03_total_families_placed = Watch(k_array_by_workplanes_organic.VARTotalFamiliesPlaced)  # "03.Total Families Placed"; graph output

removeListFromList = Custom[RH.RemoveListFromList](VARListA=k_array_by_workplanes_organic.VARElements, VARListB=k_array_by_workplanes_organic.VARElementstoErase)  # package Synthesize toolkit; This node essentially "subtracts" the contents of List B from List A to produce a new list with the unique items.
generate_selection_filter = Custom[Generate Selection Filter](VARCreateSelectionFilter=n24_create_selection_filter, VARFilterNametoCreate=n25_filter_name_to_create, VAROverwriteExistingFilter=n26_overwrite_existing_filter, VARElements=removeListFromList)  # package Synthesize toolkit; Generate Selection FIlter
eraser = Custom[ST.Tool.Eraser](VARList=k_array_by_workplanes_organic.VARElementstoErase)  # package Synthesize toolkit; Try to delete any element from project
debug_python = Custom[Debug Python]()  # package Synthesize toolkit; Debug Python
