# Dynamo graph Family.K-Override By Elements Reset Graphic Overrides.dyn (Dynamo 2.13.1.3887)
# author: karam@aecedx.com
# packages: Synthesize toolkit 12.5.1

python_all_elements_in_active = Custom[Python All Elements In Active View]()  # package Synthesize toolkit; Python All Elements In Active View

# group: Input
n04_reset_plan_views = BoolSelector(true)  # "04.Reset Plan Views"; graph input
n05_1_exact_name_2_contains_name = IntegerSlider(3, range=1..3 step 1)  # "05.1 = Exact Name | 2 = Contains Name | 3 = All"; graph input
n06_plan_view_name = StringInput("Level 1")  # "06.Plan View Name"; graph input
n13_reset_ceiling_views = BoolSelector(false)  # "13.Reset Ceiling Views"; graph input
n14_1_exact_name_2_contains_name = IntegerSlider(3, range=1..3 step 1)  # "14.1 = Exact Name | 2 = Contains Name | 3 = All"; graph input
n15_ceiling_view_name = StringInput("Level 1")  # "15.Ceiling View Name"; graph input
n22_reset_structural_views = BoolSelector(false)  # "22.Reset Structural Views"; graph input
n23_1_exact_name_2_contains_name = IntegerSlider(3, range=1..3 step 1)  # "23.1 = Exact Name | 2 = Contains Name | 3 = All"; graph input
n24_structural_view_name = StringInput("Level 1")  # "24.Structural View Name"; graph input
n16_reset_area_views = BoolSelector(false)  # "16.Reset Area Views"; graph input
n17_1_exact_name_2_contains_name = IntegerSlider(3, range=1..3 step 1)  # "17.1 = Exact Name | 2 = Contains Name | 3 = All"; graph input
n18_area_view_name = StringInput("Level 1")  # "18.Area View Name"; graph input
n07_reset_elevation_views = BoolSelector(true)  # "07.Reset Elevation Views"; graph input
n08_1_exact_name_2_contains_name = IntegerSlider(3, range=1..3 step 1)  # "08.1 = Exact Name | 2 = Contains Name | 3 = All"; graph input
n09_elevation_view_name = StringInput("North")  # "09.Elevation View Name"; graph input
n10_reset_section_views = BoolSelector(true)  # "10.Reset Section Views"; graph input
n11_1_exact_name_2_contains_name = IntegerSlider(3, range=1..3 step 1)  # "11.1 = Exact Name | 2 = Contains Name | 3 = All"; graph input
n12_section_view_name = StringInput("Section 1")  # "12.Section View Name"; graph input
n01_reset_3d_views = BoolSelector(true)  # "01.Reset 3D Views"; graph input
n02_1_exact_name_2_contains_name = IntegerSlider(3, range=1..3 step 1)  # "02.1 = Exact Name | 2 = Contains Name | 3 = All"; graph input
n03_3d_view_name = StringInput("{3D}")  # "03.3D View Name"; graph input
n19_reset_detail_views = BoolSelector(false)  # "19.Reset Detail Views"; graph input
n20_1_exact_name_2_contains_name = IntegerSlider(3, range=1..3 step 1)  # "20.1 = Exact Name | 2 = Contains Name | 3 = All"; graph input
n21_detail_view_name = StringInput("Detail 0")  # "21.Detail View Name"; graph input

python_script = Python(IN[0]=n04_reset_plan_views, IN[1]=n05_1_exact_name_2_contains_name, IN[2]=n06_plan_view_name, IN[3]=n13_reset_ceiling_views, IN[4]=n14_1_exact_name_2_contains_name, IN[5]=n15_ceiling_view_name, IN[6]=n22_reset_structural_views, IN[7]=n23_1_exact_name_2_contains_name, IN[8]=n24_structural_view_name, IN[9]=n16_reset_area_views, IN[10]=n17_1_exact_name_2_contains_name, IN[11]=n18_area_view_name, IN[12]=n07_reset_elevation_views, IN[13]=n08_1_exact_name_2_contains_name, IN[14]=n09_elevation_view_name, IN[15]=n10_reset_section_views, IN[16]=n11_1_exact_name_2_contains_name, IN[17]=n12_section_view_name, IN[18]=n01_reset_3d_views, IN[19]=n02_1_exact_name_2_contains_name, IN[20]=n03_3d_view_name, IN[21]=n19_reset_detail_views, IN[22]=n20_1_exact_name_2_contains_name, IN[23]=n21_detail_view_name)  # IronPython2
# ---------- python_script.python (231 lines) ----------
# Filtering Codes By Karam Baki, karam@aecedx.com
# Copyright(c) 2014, Konrad Sobon
# @arch_laboratory, http://archi-lab.net

import clr
clr.AddReference('ProtoGeometry')
from Autodesk.DesignScript.Geometry import *
 
# Import DocumentManager and TransactionManager
clr.AddReference("RevitServices")
import RevitServices
from RevitServices.Persistence import DocumentManager
from RevitServices.Transactions import TransactionManager
 
# Import RevitAPI
clr.AddReference("RevitAPI")
import Autodesk
from Autodesk.Revit.DB import *
 
doc = DocumentManager.Instance.CurrentDBDocument
uiapp = DocumentManager.Instance.CurrentUIApplication
app = uiapp.Application
 
from System.Collections.Generic import *
 
# Import ToDSType(bool) extension method
clr.AddReference("RevitNodes")
import Revit
clr.ImportExtensions(Revit.Elements)

#collect all views in the model
collector = FilteredElementCollector(doc)
views = collector.OfClass(View).ToElements()
 
#sort views into separate lists based on view type
areaPlans, ceilingPlans, columnSchedules = [], [], []
costReport, details, draftingViews = [], [], []
drawingSheets, elevations, engineetingPlans = [], [], []
floorPlans, internal, legends, loadReports = [], [], [], []
panelSchedules, pressureLossReports, renderings = [], [], []
reports, schedules, sections, threeD = [], [], [], []
undefined, walkthrough = [], []
for i in views:
	if not i.IsTemplate:
		if i.ViewType == ViewType.AreaPlan:
			areaPlans.append(i.ToDSType(True))
		elif i.ViewType == ViewType.CeilingPlan:
			ceilingPlans.append(i.ToDSType(True))
		elif i.ViewType == ViewType.ColumnSchedule:
			columnSchedules.append(i.ToDSType(True))
		elif i.ViewType == ViewType.CostReport:
			costReport.append(i.ToDSType(True))
		elif i.ViewType == ViewType.Detail:
			details.append(i.ToDSType(True))
		elif i.ViewType == ViewType.DraftingView:
			draftingViews.append(i.ToDSType(True))
		elif i.ViewType == ViewType.DrawingSheet:
			drawingSheets.append(i.ToDSType(True))
		elif i.ViewType == ViewType.Elevation:
			elevations.append(i.ToDSType(True))
		elif i.ViewType == ViewType.EngineeringPlan:
			engineetingPlans.append(i.ToDSType(True))
		elif i.ViewType == ViewType.FloorPlan:
			floorPlans.append(i.ToDSType(True))
		elif i.ViewType == ViewType.Internal:
			internal.append(i.ToDSType(True))
		elif i.ViewType == ViewType.Legend:
			legends.append(i.ToDSType(True))
		elif i.ViewType == ViewType.LoadsReport:
			loadReports.append(i.ToDSType(True))
		elif i.ViewType == ViewType.PanelSchedule:
			panelSchedules.append(i.ToDSType(True))
		elif i.ViewType == ViewType.PresureLossReport:
			pressureLossReports.append(i.ToDSType(True))
		elif i.ViewType == ViewType.Rendering:
			renderings.append(i.ToDSType(True))
		elif i.ViewType == ViewType.Report:
			reports.append(i.ToDSType(True))
		elif i.ViewType == ViewType.Schedule:
			schedules.append(i.ToDSType(True))
		elif i.ViewType == ViewType.Section:
			sections.append(i.ToDSType(True))
		elif i.ViewType == ViewType.ThreeD:
			threeD.append(i.ToDSType(True))
		elif i.ViewType == ViewType.Undefined:
			undefined.append(i.ToDSType(True))
		elif i.ViewType == ViewType.Walkthrough:
			walkthrough.append(i.ToDSType(True))
		else:
			continue

overrideplans = IN[0]
planscond = IN[1]
planname = IN[2].lower()

newfloorPlans = []
if overrideplans == True:
	for e in floorPlans:
		if planscond == 1:
			if e.Name.lower() == planname:
				newfloorPlans.append(e)
		elif planscond == 2:
			if planname in e.Name.lower():
				newfloorPlans.append(e)
		elif planscond == 3:
			newfloorPlans.append(e)

overrideceilings = IN[3]
ceilingscond = IN[4]
ceilingname = IN[5].lower()

newceilingPlans = []
if overrideceilings == True:
	for e in ceilingPlans:
		if ceilingscond == 1:
			if e.Name.lower() == ceilingname:
				newceilingPlans.append(e)
		elif ceilingscond == 2:
			if ceilingname in e.Name.lower():
				newceilingPlans.append(e)
		elif ceilingscond == 3:
			newceilingPlans.append(e)

overrideengineeting = IN[6]
engineetingscond = IN[7]
engineetingname = IN[8].lower()	

newengineetingPlans = []
if overrideengineeting == True:
	for e in engineetingPlans:
		if engineetingscond == 1:
			if e.Name.lower() == engineetingname:
				newengineetingPlans.append(e)
		elif engineetingscond == 2:
			if engineetingname in e.Name.lower():
				newengineetingPlans.append(e)
		elif engineetingscond == 3:
			newengineetingPlans.append(e)		
			
overridearea = IN[9]
areascond = IN[10]
areaname = IN[11].lower()	

newareaPlans = []
if overridearea == True:
	for e in areaPlans:
		if areascond == 1:
			if e.Name.lower() == areaname:
				newareaPlans.append(e)
		elif areascond == 2:
			if areaname in e.Name.lower():
				newareaPlans.append(e)
		elif areascond == 3:
			newareaPlans.append(e)

overrideelvs = IN[12]
elvsscond = IN[13]
elvsname = IN[14].lower()	

newelvs = []
if overrideelvs == True:
	for e in elevations:
		if elvsscond == 1:
			if e.Name.lower() == elvsname:
				newelvs.append(e)
		elif elvsscond == 2:
			if elvsname in e.Name.lower():
				newelvs.append(e)
		elif elvsscond == 3:
			newelvs.append(e)

overridesec = IN[15]
secscond = IN[16]
secsname = IN[17].lower()	

newsections = []
if overridesec == True:
	for e in sections:
		if secscond == 1:
			if e.Name.lower() == secsname:
				newsections.append(e)
		elif secscond == 2:
			if secsname in e.Name.lower():
				newsections.append(e)
		elif secscond == 3:
			newsections.append(e)
			
overridethreede = IN[18]
threedescond = IN[19]
threedename = IN[20].lower()	

newthreedes = []
if overridethreede == True:
	for e in threeD:
		if threedescond == 1:
			if e.Name.lower() == threedename:
				newthreedes.append(e)
		elif threedescond == 2:
			if threedename in e.Name.lower():
				newthreedes.append(e)
		elif threedescond == 3:
			newthreedes.append(e)
			
overridedet = IN[21]
detscond = IN[22]
detname = IN[23].lower()	

newdets = []
if overridedet == True:
	for e in details:
		if detscond == 1:
			if e.Name.lower() == detname:
				newdets.append(e)
		elif detscond == 2:
			if detname in e.Name.lower():
				newdets.append(e)
		elif detscond == 3:
			newdets.append(e)
			
'''
#Assign your output to the OUT variable
OUT = areaPlans, ceilingPlans, columnSchedules, costReport, \
	details, draftingViews, drawingSheets, elevations, \
	engineetingPlans, floorPlans, internal, legends, \
	loadReports, panelSchedules, pressureLossReports, \
	renderings, reports, schedules, sections, threeD, \
	undefined, walkthrough
'''

result = newfloorPlans + newceilingPlans + newengineetingPlans + newareaPlans + newelvs + newsections + newthreedes + newdets
OUT = result 
# ----------------------------------------
python_script_2 = Python(IN[0]=python_all_elements_in_active, IN[1]=python_script)  # IronPython2
# ---------- python_script_2.python (71 lines) ----------
# Created By Karam Baki : karam@aecedx.com
# Enable Python support and load DesignScript library
# IMPORTANT : ALL DYNAMO DESIGN SCRIPT NODES ARE AS (dg)
import clr
import math
clr.AddReference('ProtoGeometry')
from Autodesk.DesignScript import Geometry as dg

# EXTENSION Enable ToDSType
clr.AddReference('RevitNodes')
import Revit
clr.ImportExtensions(Revit.Elements)

# Enable Revit Elements
from Revit.Elements import *

# EXTENSION Enable Geometry Conversion Methods
clr.ImportExtensions(Revit.GeometryConversion)

# Enable Revit API
clr.AddReference('RevitAPI')
from Autodesk.Revit.DB import *

# Enable DocumentManager and TransactionManager
clr.AddReference('RevitServices')
from RevitServices.Persistence import DocumentManager
from RevitServices.Transactions import TransactionManager

# Enable ICollection List Translate
clr.AddReference("System")
import System.Collections.Generic
from System.Collections.Generic import List
from itertools import compress
#The inputs to this node will be stored as a list in the IN variables.

doc = DocumentManager.Instance.CurrentDBDocument
uidoc = DocumentManager.Instance.CurrentUIApplication.ActiveUIDocument
uiapp = DocumentManager.Instance.CurrentUIApplication
app = uiapp.Application

def flatten(x):
    result = []
    for el in x:
        if hasattr(el, "__iter__") and not isinstance(el, basestring):
            result.extend(flatten(el))
        else:
            result.append(el)
    return result

elems = UnwrapElement(IN[0])
elems = flatten(elems)
allviews = UnwrapElement(IN[1])

#result=[]
active = uidoc.ActiveView

TransactionManager.Instance.EnsureInTransaction(doc)

graphsettings = OverrideGraphicSettings()

count = 0
for v in allviews:
	for e in elems:
		try:
			v.SetElementOverrides(e.Id, graphsettings)
		except:
			pass
	count + 1
TransactionManager.Instance.TransactionTaskDone()

OUT = "DONE"
# ----------------------------------------
debug_python_no_message = Custom[Debug Python No Message]()  # package Synthesize toolkit; Debug Python
