# Dynamo graph Family.K-Override Random Colors By Family and Type.dyn (Dynamo 2.13.1.3887)
# author: karam@aecedx.com
# packages: Synthesize toolkit 12.5.1

# group: Input
n02_all_elements_of_family_name = BoolSelector(true)  # "02.All Elements of Family Name (All types) ?"; graph input
n01_family_names_separate_by = StringInput("Family")  # "01.Family Names (Separate By Comma , - or * To Select All Matching)"; graph input
n03_specific_type_names_separate = StringInput("Type")  # "03.Specific Type Names (Separate by Comma , )"; graph input
n04_elements_in_active_view_only = BoolSelector(false)  # "04.Elements In Active View Only ?"; graph input
n07_override_cut_fill_colors = BoolSelector(false)  # "07.Override Cut Fill Colors ?"; graph input
n08_force_cut_fill_color_with = BoolSelector(false)  # "08.Force Cut Fill Color With Black ?"; graph input
n05_override_projection_fill = BoolSelector(true)  # "05.Override Projection Fill Colors ?"; graph input
n11_override_cut_lines_color = BoolSelector(false)  # "11.Override Cut Lines Color ?"; graph input
n10_override_projection_lines = BoolSelector(false)  # "10.Override Projection Lines Color ?"; graph input
n09_cut_pattern = FillPatterns("<Solid fill>")  # "09.Cut Pattern"; graph input
n06_projection_pattern = FillPatterns("<Solid fill>")  # "06.Projection Pattern"; graph input
transparancy = DoubleSlider(0, range=0..100 step 1)  # "12.Transparancy"; graph input

code_block = CodeBlock { ","; }
family_and_type_selector = Custom[Family and Type Selector](VARAllElementsofFamilyNameAlltypes=n02_all_elements_of_family_name, VARFamilyName=n01_family_names_separate_by, VARSpecificTypeNamesSeparatebySymbol=n03_specific_type_names_separate, VARSeparationSymbol=code_block, VAROnlyInActiveView=n04_elements_in_active_view_only)  # package Synthesize toolkit; Family and Type Selector
code_block_2 = CodeBlock { 255; 0; }
byARGB = Color.ByARGB(alpha=code_block_2.out0, red=code_block_2.out1, green=code_block_2.out1, blue=code_block_2.out1)
colorPicker = Custom[RH.UI.ColorPicker]()  # package Synthesize toolkit; This node allows the user to choose a color via the Revit API color selection dialog. For Revit 2017 +
colorPicker_2 = Custom[RH.UI.ColorPicker]()
colorPicker_3 = Custom[RH.UI.ColorPicker]()
create = List.Create(item0=colorPicker.VARdynamoColor, item1=colorPicker_2.VARdynamoColor, item2=colorPicker_3.VARdynamoColor)
code_block_3 = CodeBlock { 1; }
count = List.Count(list=create)
sequence = Sequence(start=code_block_3, amount=count, step=code_block_3, lacing=Longest)
code_block_4 = CodeBlock { 0; 1; null; }
remapRange = Math.RemapRange(numbers=sequence, newMin=code_block_4.out0, newMax=code_block_4.out1)
count_2 = List.Count(list=family_and_type_selector.VARElements)
sequence_2 = Sequence(start=code_block_3, amount=count_2, step=code_block_3, lacing=Longest)
remapRange_2 = Math.RemapRange(numbers=sequence_2, newMin=code_block_4.out0, newMax=code_block_4.out1)
color_range = ColorRange(colors=create, indices=remapRange, value=remapRange_2)
shuffle = List.Shuffle(list=color_range)
alpha = Color.Alpha(color=shuffle)
red = Color.Red(color=shuffle)
green = Color.Green(color=shuffle)
blue = Color.Blue(color=shuffle)
byARGB_2 = Color.ByARGB(alpha=alpha, red=red, green=green, blue=blue)
count_3 = List.Count(list=byARGB_2)
cycle = List.Cycle(list=byARGB, amount=count_3)
scopeIf = Custom[CW.ScopeIf+](VARtest=n08_force_cut_fill_color_with, VARtrue=cycle, VARfalse=byARGB_2)  # package Synthesize toolkit; A (hopefully) more robust implementation of ScopeIf. Tests a single boolean and returns a value accordingly.
scopeIf_2 = Custom[CW.ScopeIf+](VARtest=n07_override_cut_fill_colors, VARtrue=scopeIf, VARfalse=byARGB_2)
python_empty_2_null = Custom[Python Empty 2 Null](VARIN=scopeIf_2)  # package Synthesize toolkit; Python Null 2 Empty
code_block_5 = CodeBlock { null; }
scopeIf_3 = Custom[CW.ScopeIf+](VARtest=n05_override_projection_fill, VARtrue=byARGB_2, VARfalse=code_block_5)
python_empty_2_null_2 = Custom[Python Empty 2 Null](VARIN=scopeIf_3)
code_block_6 = CodeBlock { null; }
scopeIf_4 = Custom[CW.ScopeIf+](VARtest=n11_override_cut_lines_color, VARtrue=byARGB_2, VARfalse=code_block_6)
python_empty_2_null_3 = Custom[Python Empty 2 Null](VARIN=scopeIf_4)
scopeIf_5 = Custom[CW.ScopeIf+](VARtest=n10_override_projection_lines, VARtrue=byARGB_2, VARfalse=code_block_6)
python_empty_2_null_4 = Custom[Python Empty 2 Null](VARIN=scopeIf_5)
code_block_7 = CodeBlock { null; }
scopeIf_6 = Custom[CW.ScopeIf+](VARtest=n07_override_cut_fill_colors, VARtrue=n09_cut_pattern, VARfalse=code_block_7)
python_empty_2_null_5 = Custom[Python Empty 2 Null](VARIN=scopeIf_6)
scopeIf_7 = Custom[CW.ScopeIf+](VARtest=n05_override_projection_fill, VARtrue=n06_projection_pattern, VARfalse=code_block_5)
python_empty_2_null_6 = Custom[Python Empty 2 Null](VARIN=scopeIf_7)
id = Element.Id(element=family_and_type_selector.VARElements)
count_4 = List.Count(list=id)
cycle_2 = List.Cycle(list=transparancy, amount=count_4)
python_empty_2_null_7 = Custom[Python Empty 2 Null](VARIN=cycle_2)
byProperties = Revit.Filter.OverrideGraphicSettings.ByProperties(cutFillColor=python_empty_2_null, projectionFillColor=python_empty_2_null_2, cutLineColor=python_empty_2_null_3, projectionLineColor=python_empty_2_null_4, cutFillPattern=python_empty_2_null_5, projectionFillPattern=python_empty_2_null_6, transparency=python_empty_2_null_7, lacing=Longest)
overrideInView = Element.OverrideInView(element=family_and_type_selector.VARElements, overrides=byProperties)
count_5 = List.Count(list=overrideInView)

# group: Report
n01_number_of_selected_elements = Watch(count_5)  # "01.Number of Selected Elements"; graph output

debug_python = Custom[Debug Python]()  # package Synthesize toolkit; Debug Python
