# Dynamo graph Family.K-Override Random Colors By Selection.dyn (Dynamo 2.13.1.3887)
# author: karam@aecedx.com
# packages: Synthesize toolkit 12.5.1

# group: Input
n01_select_elements_to_randomize = DSModelElementsSelection()  # "01.Select Elements to Randomize Their Colors"; nothing selected; graph input
n04_override_cut_fill_colors = BoolSelector(false)  # "04.Override Cut Fill Colors ?"; graph input
n05_force_cut_fill_color_with = BoolSelector(false)  # "05.Force Cut Fill Color With Black ?"; graph input
n02_override_projection_fill = BoolSelector(true)  # "02.Override Projection Fill Colors ?"; graph input
n08_override_cut_lines_color = BoolSelector(false)  # "08.Override Cut Lines Color ?"; graph input
n07_override_projection_lines = BoolSelector(false)  # "07.Override Projection Lines Color ?"; graph input
n06_cut_pattern = FillPatterns("<Solid fill>")  # "06.Cut Pattern"; graph input
n03_projection_pattern = FillPatterns("<Solid fill>")  # "03.Projection Pattern"; graph input
transparancy = DoubleSlider(0, range=0..100 step 1)  # "09.Transparancy"; graph input

code_block = CodeBlock { 255; 0; }
byARGB = Color.ByARGB(alpha=code_block.out0, red=code_block.out1, green=code_block.out1, blue=code_block.out1)
colorPicker = Custom[RH.UI.ColorPicker]()  # package Synthesize toolkit; This node allows the user to choose a color via the Revit API color selection dialog. For Revit 2017 +
colorPicker_2 = Custom[RH.UI.ColorPicker]()
colorPicker_3 = Custom[RH.UI.ColorPicker]()
create = List.Create(item0=colorPicker.VARdynamoColor, item1=colorPicker_2.VARdynamoColor, item2=colorPicker_3.VARdynamoColor)
code_block_2 = CodeBlock { 1; }
count = List.Count(list=create)
sequence = Sequence(start=code_block_2, amount=count, step=code_block_2, lacing=Longest)
code_block_3 = CodeBlock { 0; 1; null; }
remapRange = Math.RemapRange(numbers=sequence, newMin=code_block_3.out0, newMax=code_block_3.out1)
count_2 = List.Count(list=n01_select_elements_to_randomize)
sequence_2 = Sequence(start=code_block_2, amount=count_2, step=code_block_2, lacing=Longest)
remapRange_2 = Math.RemapRange(numbers=sequence_2, newMin=code_block_3.out0, newMax=code_block_3.out1)
color_range = ColorRange(colors=create, indices=remapRange, value=remapRange_2)
shuffle = List.Shuffle(list=color_range)
alpha = Color.Alpha(color=shuffle)
red = Color.Red(color=shuffle)
green = Color.Green(color=shuffle)
blue = Color.Blue(color=shuffle)
byARGB_2 = Color.ByARGB(alpha=alpha, red=red, green=green, blue=blue)
count_3 = List.Count(list=byARGB_2)
cycle = List.Cycle(list=byARGB, amount=count_3)
scopeIf = Custom[CW.ScopeIf+](VARtest=n05_force_cut_fill_color_with, VARtrue=cycle, VARfalse=byARGB_2)  # package Synthesize toolkit; A (hopefully) more robust implementation of ScopeIf. Tests a single boolean and returns a value accordingly.
scopeIf_2 = Custom[CW.ScopeIf+](VARtest=n04_override_cut_fill_colors, VARtrue=scopeIf, VARfalse=byARGB_2)
python_empty_2_null = Custom[Python Empty 2 Null](VARIN=scopeIf_2)  # package Synthesize toolkit; Python Null 2 Empty
code_block_4 = CodeBlock { null; }
scopeIf_3 = Custom[CW.ScopeIf+](VARtest=n02_override_projection_fill, VARtrue=byARGB_2, VARfalse=code_block_4)
python_empty_2_null_2 = Custom[Python Empty 2 Null](VARIN=scopeIf_3)
code_block_5 = CodeBlock { null; }
scopeIf_4 = Custom[CW.ScopeIf+](VARtest=n08_override_cut_lines_color, VARtrue=byARGB_2, VARfalse=code_block_5)
python_empty_2_null_3 = Custom[Python Empty 2 Null](VARIN=scopeIf_4)
scopeIf_5 = Custom[CW.ScopeIf+](VARtest=n07_override_projection_lines, VARtrue=byARGB_2, VARfalse=code_block_5)
python_empty_2_null_4 = Custom[Python Empty 2 Null](VARIN=scopeIf_5)
code_block_6 = CodeBlock { null; }
scopeIf_6 = Custom[CW.ScopeIf+](VARtest=n04_override_cut_fill_colors, VARtrue=n06_cut_pattern, VARfalse=code_block_6)
python_empty_2_null_5 = Custom[Python Empty 2 Null](VARIN=scopeIf_6)
scopeIf_7 = Custom[CW.ScopeIf+](VARtest=n02_override_projection_fill, VARtrue=n03_projection_pattern, VARfalse=code_block_4)
python_empty_2_null_6 = Custom[Python Empty 2 Null](VARIN=scopeIf_7)
id = Element.Id(element=n01_select_elements_to_randomize)
count_4 = List.Count(list=id)
cycle_2 = List.Cycle(list=transparancy, amount=count_4)
python_empty_2_null_7 = Custom[Python Empty 2 Null](VARIN=cycle_2)
byProperties = Revit.Filter.OverrideGraphicSettings.ByProperties(cutFillColor=python_empty_2_null, projectionFillColor=python_empty_2_null_2, cutLineColor=python_empty_2_null_3, projectionLineColor=python_empty_2_null_4, cutFillPattern=python_empty_2_null_5, projectionFillPattern=python_empty_2_null_6, transparency=python_empty_2_null_7, lacing=Longest)
overrideInView = Element.OverrideInView(element=n01_select_elements_to_randomize, overrides=byProperties)
count_5 = List.Count(list=overrideInView)

# group: Report
n01_number_of_selected_elements = Watch(count_5)  # "01.Number of Selected Elements"; graph output

debug_python = Custom[Debug Python]()  # package Synthesize toolkit; Debug Python
