# Dynamo graph Family.K-Paneling Data Import.dyn (Dynamo 2.13.1.3887)
# author: karam@aecedx.com
# packages: Synthesize toolkit 12.5.1

debug_python = Custom[Debug Python]()  # package Synthesize toolkit; Debug Python

# group: Input
n01_path_to_scan = Directory("C:\Users\Karam\Desktop")  # "01.Path to Scan"; graph input
n10_family_name = StringInput("Dynamo K-Paneling")  # "10.Family Name"; graph input
category = Categories("OST_GenericModel")  # "11.Category"; graph input
n12_family_template_of_the_above = Filename("..\..\..\..\..\..\..\..\..\..\ProgramData\Autodesk\RVT 2020\Family Templates\English\Metric Generic Model.rft")  # "12.Family Template of The Above Category"; graph input
n02_glazed_border_material = StringInput("Aluminum")  # "02.Glazed: Border Material"; graph input
n03_glazed_mullions_material = StringInput("Aluminum")  # "03.Glazed: Mullions Material"; graph input
n04_glazed_glass_material = StringInput("Glass")  # "04.Glazed: Glass Material"; graph input
n05_solid_border_material = StringInput("Aluminum")  # "05.Solid: Border Material"; graph input
n06_solid_separator_material = StringInput("Aluminum")  # "06.Solid: Separator Material"; graph input
n07_solid_panels_material = StringInput("Plastic")  # "07.Solid: Panels Material"; graph input
n09_material_single_parameter = BoolSelector(false)  # "09.Material: Single Parameter Only ?"; graph input
n08_material_is_instance = BoolSelector(true)  # "08.Material: Is Instance Parameter ?"; graph input

python_script = Python(IN[0]=n01_path_to_scan)  # IronPython2
# ---------- python_script.python (56 lines) ----------
# Load the Python Standard and DesignScript Libraries
import sys
import clr
clr.AddReference('ProtoGeometry')
from Autodesk.DesignScript.Geometry import *
import os

def fast_files(dir):
    allfiles = [os.path.join(path, name) for path, subdirs, files in os.walk(dir) for name in files]
    return allfiles

def tryimport(satfile):
	try:
		geom = Geometry.ImportFromSAT(satfile)
	except:
		geom = None
	return geom

directory = IN[0]
wanted = []
solidstat = []
scan = os.listdir(directory)
for d in scan:
	if os.path.isdir(directory + "\\" + d) and "K-Paneling" in d and "Finished" not in d:
		fulldir = directory + "\\" + d
		files = fast_files(fulldir)
		tmp = []
		solid = []
		mullionfile = None
		panelsfile = None
		framesfile = None
		for f in files:
			if " Mullions.sat" in f:
				mullionfile = f
				if "Solid" in f:
					solid.append(True)
				continue
			if " Panels.sat" in f:
				panelsfile = f
				if "Solid" in f:
					solid.append(True)
				continue
			if " Frames.sat" in f:
				framesfile = f
				if "Solid" in f:
					solid.append(True)
				continue
		tmp.append(tryimport(mullionfile))
		tmp.append(tryimport(panelsfile))
		tmp.append(tryimport(framesfile))
		solidstat.append(any(solid))
		os.rename(fulldir, fulldir + " Finished")
		wanted.append(tmp)

# Assign your output to the OUT variable.
OUT = wanted,solidstat
# ----------------------------------------
list_firstitem_fixer = Custom[List.FirstItem Fixer](VARlist=python_script)  # package Synthesize toolkit; List.FirstItem Fixer
list_firstitem_fixer_2 = Custom[List.FirstItem Fixer](VARlist=list_firstitem_fixer@@L3)
code_block = CodeBlock(a=n10_family_name) { a + " Mullions"; }
smart_rft_path = Custom[Smart RFT Path](VARRFTFile=n12_family_template_of_the_above, VARCategory=category)  # package Synthesize toolkit; Smart RFT Path
list_lastitem_fixer = Custom[List.LastItem Fixer](VARlist=python_script)  # package Synthesize toolkit; List.LastItem Fixer
python_script_2 = Python(IN[0]=list_lastitem_fixer, IN[1]=n02_glazed_border_material, IN[2]=n03_glazed_mullions_material, IN[3]=n04_glazed_glass_material, IN[4]=n05_solid_border_material, IN[5]=n06_solid_separator_material, IN[6]=n07_solid_panels_material)  # IronPython2
# ---------- python_script_2.python (30 lines) ----------
# Load the Python Standard and DesignScript Libraries
import sys
import clr
clr.AddReference('ProtoGeometry')
from Autodesk.DesignScript.Geometry import *

status = IN[0]
gb = IN[1]
gm = IN[2]
gg = IN[3]
sb = IN[4]
ss = IN[5]
sp = IN[6]

bords = []
mulls = []
pans = []
for s in status:
	if s == True:
		bords.append(sb)
		mulls.append(ss)
		pans.append(sp)
	else:
		bords.append(gb)
		mulls.append(gm)
		pans.append(gg)
# Place your code below this line

# Assign your output to the OUT variable.
OUT = bords,mulls,pans
# ----------------------------------------
python_empty_2_null = Custom[Python Empty 2 Null](VARIN=python_script_2)  # package Synthesize toolkit; Python Null 2 Empty
code_block_2 = CodeBlock { 1; }
list_getitematindex_fixer = Custom[List.GetItemAtIndex Fixer](VARlist=python_empty_2_null, VARindex=code_block_2)  # package Synthesize toolkit; List.GetItemAtIndex Fixer
k_family_insert = Custom[K-Family Insert](VARGeometryorSAT=list_firstitem_fixer_2@L2, VARFamilyName=code_block, VARFamilyCategory=category, VARFamilyTemplatePath=smart_rft_path, VARMaterialName=list_getitematindex_fixer@L1, VARIsOneMaterial=n09_material_single_parameter, VARIsMaterialInstance=n08_material_is_instance)  # package Synthesize toolkit; K-Family Insert
python_empty_2_null_2 = Custom[Python Empty 2 Null](VARIN=list_firstitem_fixer)
list_getitematindex_fixer_2 = Custom[List.GetItemAtIndex Fixer](VARlist=python_empty_2_null_2@@L3, VARindex=code_block_2)
code_block_3 = CodeBlock(a=n10_family_name) { a + " Panels"; }
list_lastitem_fixer_2 = Custom[List.LastItem Fixer](VARlist=python_script_2)
k_family_insert_2 = Custom[K-Family Insert](VARGeometryorSAT=list_getitematindex_fixer_2@L2, VARFamilyName=code_block_3, VARFamilyCategory=category, VARFamilyTemplatePath=smart_rft_path, VARMaterialName=list_lastitem_fixer_2@L1, VARIsOneMaterial=n09_material_single_parameter, VARIsMaterialInstance=n08_material_is_instance)
list_lastitem_fixer_3 = Custom[List.LastItem Fixer](VARlist=list_firstitem_fixer@@L3)
code_block_4 = CodeBlock(a=n10_family_name) { a + " Frame"; }
list_firstitem_fixer_3 = Custom[List.FirstItem Fixer](VARlist=python_script_2)
k_family_insert_3 = Custom[K-Family Insert](VARGeometryorSAT=list_lastitem_fixer_3@L2, VARFamilyName=code_block_4, VARFamilyCategory=category, VARFamilyTemplatePath=smart_rft_path, VARMaterialName=list_firstitem_fixer_3@L1, VARIsOneMaterial=n09_material_single_parameter, VARIsMaterialInstance=n08_material_is_instance)
