# Dynamo graph Family.K-Paneling Glazed.dyn (Dynamo 2.13.1.3887)
# author: karam@aecedx.com
# packages: Synthesize toolkit 12.5.1

debug_python = Custom[Debug Python]()  # package Synthesize toolkit; Debug Python
categories = Categories("OST_CurtaSystem")
all_elements_of_category = ElementsOfCategory(Category=categories)

# group: Input
n02_fetch_whole_body = BoolSelector(false)  # "02.Fetch Whole Body ?"; graph input
n05_normalize_quad_faces = BoolSelector(false)  # "05.Normalize Quad Faces ?"; graph input
n06_uv_info_from_divided_surface = BoolSelector(false)  # "06.UV Info From Divided Surface or Curtain Systems ?"; graph input
n01_select_faces = SelectFaces()  # "01.Select Faces"; nothing selected; graph input
n03_faces_filter_1_vertical_faces = IntegerSlider(4, range=1..4 step 1)  # "03.Faces Filter (1 = Vertical Faces | 2 = Horizontal Up Faces | 3 = Horizontal Down Faces | 4 = All Faces)"; graph input
n04_faces_offset = DoubleInput(0)  # "04.Faces Offset"; graph input
re_loft_faces_distancing = DoubleInput(2)
re_loft_faces = BoolSelector(false)
re_loft_faces_flip_direction = BoolSelector(false)
n33_data_export_mode_only = BoolSelector(false)  # "33.DATA EXPORT MODE ONLY"; graph input
n15_border_depth = DoubleInput(0.2)  # "15.Border Depth"; graph input
n14_border_width = DoubleInput(0.1)  # "14.Border Width"; graph input
n07_exact_uv_divided_surface_or = BoolSelector(false)  # "07.Exact UV Divided Surface or Curtain Systems Grids ? (False Will Only Take Grids Numbers)"; graph input
n08_reverse_u_with_v_of_divided = BoolSelector(false)  # "08.Reverse U with V of Divided Surface or Curtain Systems ?"; graph input
n10_number_distance_u = DoubleInput(5)  # "10.Number/Distance U"; graph input
n12_number_distance_v = DoubleInput(5)  # "12.Number/Distance V"; graph input
n09_u_spacing_method_false_by = BoolSelector(false)  # "09.U Spacing Method (False = By Number | True = Spacing)"; graph input
n11_v_spacing_method_false_by = BoolSelector(false)  # "11.V Spacing Method (False = By Number | True = Spacing)"; graph input
n17_u_mullion_width = DoubleInput(0.2)  # "17.U Mullion Width"; graph input
n18_u_mullion_depth = DoubleInput(0.15)  # "18.U Mullion Depth"; graph input
n20_v_mullion_width = DoubleInput(0.2)  # "20.V Mullion Width"; graph input
n21_v_mullion_depth = DoubleInput(0.1)  # "21.V Mullion Depth"; graph input
n24_panels_thickness = DoubleInput(0.03)  # "24.Panels Thickness"; graph input
n22_create_panels = BoolSelector(true)  # "22.Create Panels ?"; graph input
n16_u_offset = DoubleInput(0)  # "16.U Offset"; graph input
n19_v_offset = DoubleInput(0)  # "19.V Offset"; graph input
n23_panels_offset = DoubleInput(0)  # "23.Panels Offset"; graph input
n13_border_offset = DoubleInput(0)  # "13.Border Offset"; graph input
n30_family_name = StringInput("Dynamo K-Paneling")  # "30.Family Name"; graph input
category = Categories("OST_GenericModel")  # "31.Category"; graph input
n32_family_template_of_the_above = Filename("..\..\..\..\..\..\..\..\..\..\ProgramData\Autodesk\RVT 2020\Family Templates\English\Metric Generic Model.rft")  # "32.Family Template of The Above Category"; graph input
n26_mullions_material = StringInput("Aluminum")  # "26.Mullions Material"; graph input
n29_material_single_parameter = BoolSelector(false)  # "29.Material: Single Parameter Only ?"; graph input
n28_material_is_instance = BoolSelector(true)  # "28.Material: Is Instance Parameter ?"; graph input
n27_panels_material = StringInput("Glass")  # "27.Panels Material"; graph input
n25_border_material = StringInput("Aluminum")  # "25.Border Material"; graph input
n34_data_export_path = Directory("C:\Users\Karam\Desktop")  # "34.DATA EXPORT: PATH"; graph input
n35_data_export_consider_as_solid = BoolSelector(false)  # "35.DATA EXPORT: CONSIDER AS SOLID ?"; graph input

python_script = Python(IN[0]=n05_normalize_quad_faces, IN[1]=n06_uv_info_from_divided_surface)  # IronPython2
# ---------- python_script.python (17 lines) ----------
# Load the Python Standard and DesignScript Libraries
import sys
import clr
clr.AddReference('ProtoGeometry')
from Autodesk.DesignScript.Geometry import *

# The inputs to this node will be stored as a list in the IN variables.
dataEnteringNode = IN

# Place your code below this line
normalize = IN[0]
uvcurtain = IN[1]

if normalize == True:
	OUT = False
else:
	OUT = uvcurtain
# ----------------------------------------
python_script_2 = Python(IN[0]=n02_fetch_whole_body, IN[1]=python_script)  # IronPython2
# ---------- python_script_2.python (17 lines) ----------
# Load the Python Standard and DesignScript Libraries
import sys
import clr
clr.AddReference('ProtoGeometry')
from Autodesk.DesignScript.Geometry import *

# The inputs to this node will be stored as a list in the IN variables.
dataEnteringNode = IN

whole = IN[0]
uvcurtain = IN[1]

if uvcurtain:
	whole = False

# Assign your output to the OUT variable.
OUT = whole
# ----------------------------------------
code_block = CodeBlock { true; }
ne = python_script_2 != code_block
fetch_whole_body = Custom[Fetch Whole Body](VARFetchorNot=python_script_2, VARSurfaces=n01_select_faces)  # package Synthesize toolkit; Fetch Whole Body
surface_importer_2x = Custom[Surface Importer 2x](VAROperate=ne, VARSurfaces=fetch_whole_body)  # package Synthesize toolkit; Surface Importer Updated
flatten = List.Flatten(list=surface_importer_2x)
surface_orientation_filter = Custom[Surface Orientation Filter](VARSurfaces=flatten, VAROrienataion=n03_faces_filter_1_vertical_faces)  # package Synthesize toolkit; Face Filter
get_curtain_system_or_divided = Custom[Get Curtain System or Divided Surface](VARCurtainSystems=all_elements_of_category, VARFaces=surface_orientation_filter.VARSurfaces, VARGetorNot=python_script, VAROriginalFaces=surface_orientation_filter.VARSurfaces)  # package Synthesize toolkit; Get Curtain System or Divided Surface
smart_surface_offset_with_reloft = Custom[Smart Surface Offset With Reloft](VARSurfaces=get_curtain_system_or_divided.VARSurfaces, VARDistances=n04_faces_offset, VARReloftDistancing=re_loft_faces_distancing, VARPerformReloft=re_loft_faces, VARGetUVFromCurtain=python_script, VARFlipBalancingDirection=re_loft_faces_flip_direction)  # package Synthesize toolkit; Smart Surface Offset With Reloft
code_block_2 = CodeBlock { null; }
understand_quad_faces = Custom[Understand Quad Faces](VARSurfaces=smart_surface_offset_with_reloft.VARSurfaces, VARUnderstandorNot=n05_normalize_quad_faces)  # package Synthesize toolkit; Try to Normalize Faces
get_curtain_system_or_divided_2 = Custom[Get Curtain System or Divided Surface](VARCurtainSystems=all_elements_of_category, VARFaces=understand_quad_faces, VARGetorNot=python_script, VAROriginalFaces=smart_surface_offset_with_reloft.VAROriginalSurfaces)
scopeIf = Custom[CW.ScopeIf+](VARtest=n33_data_export_mode_only, VARtrue=code_block_2, VARfalse=get_curtain_system_or_divided_2.VARSurfaces)  # package Synthesize toolkit; A (hopefully) more robust implementation of ScopeIf. Tests a single boolean and returns a value accordingly.
python_script_3 = Python(IN[0]=n06_uv_info_from_divided_surface, IN[1]=n07_exact_uv_divided_surface_or)  # IronPython2
# ---------- python_script_3.python (17 lines) ----------
# Load the Python Standard and DesignScript Libraries
import sys
import clr
clr.AddReference('ProtoGeometry')
from Autodesk.DesignScript.Geometry import *

# The inputs to this node will be stored as a list in the IN variables.
dataEnteringNode = IN

# Place your code below this line
uvcurtain = IN[0]
exact = IN[1]

if uvcurtain == False:
	OUT = False
else:
	OUT = exact
# ----------------------------------------
code_block_3 = CodeBlock { null; }
scopeIf_2 = Custom[CW.ScopeIf+](VARtest=python_script_3, VARtrue=get_curtain_system_or_divided_2.VARUGrid, VARfalse=get_curtain_system_or_divided_2.VARCountU)
count = List.Count(list=get_curtain_system_or_divided_2.VARSurfaces)
cycle = List.Cycle(list=n10_number_distance_u, amount=count)
scopeIf_3 = Custom[CW.ScopeIf+](VARtest=python_script, VARtrue=scopeIf_2, VARfalse=cycle)
scopeIf_4 = Custom[CW.ScopeIf+](VARtest=python_script_3, VARtrue=get_curtain_system_or_divided_2.VARVGrid, VARfalse=get_curtain_system_or_divided_2.VARCountV)
cycle_2 = List.Cycle(list=n12_number_distance_v, amount=count)
scopeIf_5 = Custom[CW.ScopeIf+](VARtest=python_script, VARtrue=scopeIf_4, VARfalse=cycle_2)
python_script_4 = Python(IN[0]=n08_reverse_u_with_v_of_divided, IN[1]=scopeIf_3, IN[2]=scopeIf_5)  # IronPython2
# ---------- python_script_4.python (17 lines) ----------
# Load the Python Standard and DesignScript Libraries
import sys
import clr
clr.AddReference('ProtoGeometry')
from Autodesk.DesignScript.Geometry import *

# The inputs to this node will be stored as a list in the IN variables.
dataEnteringNode = IN

rev = IN[0]
l1 = IN[1]
l2 = IN[2]

if rev == True:
	OUT = l2,l1
else:
	OUT = l1,l2
# ----------------------------------------
code_block_4 = CodeBlock(a=python_script_4) { a[0]; a[1]; }
scopeIf_6 = Custom[CW.ScopeIf+](VARtest=python_script_3, VARtrue=code_block_3, VARfalse=code_block_4.out0)
scopeIf_7 = Custom[CW.ScopeIf+](VARtest=python_script_3, VARtrue=code_block_3, VARfalse=code_block_4.out1)
python_script_5 = Python(IN[0]=python_script, IN[1]=n09_u_spacing_method_false_by, IN[2]=n11_v_spacing_method_false_by)  # IronPython2
# ---------- python_script_5.python (17 lines) ----------
# Load the Python Standard and DesignScript Libraries
import sys
import clr
clr.AddReference('ProtoGeometry')
from Autodesk.DesignScript.Geometry import *

# The inputs to this node will be stored as a list in the IN variables.
sys = IN[0]
umeth = IN[1]
vmeth = IN[2]

if sys == True:
	umeth = False
	vmeth = False

# Assign your output to the OUT variable.
OUT = umeth,vmeth
# ----------------------------------------
code_block_5 = CodeBlock(a=python_script_5) { a[0]; a[1]; }
extend_fix_in_feet = DoubleInput(3.3)
precision_in_feet = DoubleInput(1.15)
safe_thicken_factor_in_feet = DoubleInput(1.65)
scopeIf_8 = Custom[CW.ScopeIf+](VARtest=python_script_3, VARtrue=code_block_4.out0, VARfalse=code_block_3)
scopeIf_9 = Custom[CW.ScopeIf+](VARtest=python_script_3, VARtrue=code_block_4.out1, VARfalse=code_block_3)
k_paneling = Custom[K-Paneling](VARSurfaces=scopeIf, VARBorderDepth=n15_border_depth, VARBorderWidth=n14_border_width, VARDistanceU=scopeIf_6, VARDistanaceV=scopeIf_7, VARMethodU=code_block_5.out0, VARMethodV=code_block_5.out1, VARUWidth=n17_u_mullion_width, VARUDepth=n18_u_mullion_depth, VARVWidth=n20_v_mullion_width, VARVDepth=n21_v_mullion_depth, VARExtendFix=extend_fix_in_feet, VARPrecision=precision_in_feet, VARPanelThickness=n24_panels_thickness, VARCreatePanels=n22_create_panels, VARSafeThickenFactor=safe_thicken_factor_in_feet, VARCustomGridU=scopeIf_8, VARCustomGridV=scopeIf_9, VARUOffset=n16_u_offset, VARVOffset=n19_v_offset, VARPanelOffset=n23_panels_offset, VARBorderOffset=n13_border_offset)  # package Synthesize toolkit; K-Paneling
list_firstitem_fixer = Custom[List.FirstItem Fixer](VARlist=k_paneling)  # package Synthesize toolkit; List.FirstItem Fixer
code_block_6 = CodeBlock(a=n30_family_name) { a + " Mullions"; }
smart_rft_path = Custom[Smart RFT Path](VARRFTFile=n32_family_template_of_the_above, VARCategory=category)  # package Synthesize toolkit; Smart RFT Path
k_family_insert = Custom[K-Family Insert](VARGeometryorSAT=list_firstitem_fixer, VARFamilyName=code_block_6, VARFamilyCategory=category, VARFamilyTemplatePath=smart_rft_path, VARMaterialName=n26_mullions_material, VARIsOneMaterial=n29_material_single_parameter, VARIsMaterialInstance=n28_material_is_instance)  # package Synthesize toolkit; K-Family Insert
code_block_7 = CodeBlock { 1; }
list_getitematindex_fixer = Custom[List.GetItemAtIndex Fixer](VARlist=k_paneling, VARindex=code_block_7)  # package Synthesize toolkit; List.GetItemAtIndex Fixer
python_flatten = Custom[Python Flatten](VARList=list_getitematindex_fixer)  # package Synthesize toolkit; Python Flatten
code_block_8 = CodeBlock(a=n30_family_name) { a + " Panels"; }
k_family_insert_2 = Custom[K-Family Insert](VARGeometryorSAT=python_flatten, VARFamilyName=code_block_8, VARFamilyCategory=category, VARFamilyTemplatePath=smart_rft_path, VARMaterialName=n27_panels_material, VARIsOneMaterial=n29_material_single_parameter, VARIsMaterialInstance=n28_material_is_instance)
list_lastitem_fixer = Custom[List.LastItem Fixer](VARlist=k_paneling)  # package Synthesize toolkit; List.LastItem Fixer
code_block_9 = CodeBlock(a=n30_family_name) { a + " Frame"; }
k_family_insert_3 = Custom[K-Family Insert](VARGeometryorSAT=list_lastitem_fixer, VARFamilyName=code_block_9, VARFamilyCategory=category, VARFamilyTemplatePath=smart_rft_path, VARMaterialName=n25_border_material, VARIsOneMaterial=n29_material_single_parameter, VARIsMaterialInstance=n28_material_is_instance)
list_create = List.Create(item0=k_family_insert.VARFamilyInstancesOrImportSymbols, item1=k_family_insert_2.VARFamilyInstancesOrImportSymbols, item2=k_family_insert_3.VARFamilyInstancesOrImportSymbols)
alert_popup_with_wait = Custom[Alert Popup With Wait](VARMessage=smart_surface_offset_with_reloft.VARMessage, VARWaitfor=list_create)  # package Synthesize toolkit; Popup a message dialog in Revit
k_paneling_data_export = Custom[K-Paneling Data Export](VARSurfaces=get_curtain_system_or_divided_2.VARSurfaces, VARBorderDepth=n15_border_depth, VARBorderWidth=n14_border_width, VARDistanceU=scopeIf_6, VARDistanaceV=scopeIf_7, VARMethodU=code_block_5.out0, VARMethodV=code_block_5.out1, VARUWidth=n17_u_mullion_width, VARUDepth=n18_u_mullion_depth, VARVWidth=n20_v_mullion_width, VARVDepth=n21_v_mullion_depth, VARExtendFix=extend_fix_in_feet, VARPrecision=precision_in_feet, VARPanelThickness=n24_panels_thickness, VARCreatePanels=n22_create_panels, VARSafeThickenFactor=safe_thicken_factor_in_feet, VARCustomGridU=scopeIf_8, VARCustomGridV=scopeIf_9, VARUOffset=n16_u_offset, VARVOffset=n19_v_offset, VARPanelOffset=n23_panels_offset, VARBorderOffset=n13_border_offset, VARDirectoryPath=n34_data_export_path, VARGo=n33_data_export_mode_only, VARIsSolid=n35_data_export_consider_as_solid)  # package Synthesize toolkit; K-Paneling Data Export
