# Dynamo graph Family.K-Patternize By Family Selection.dyn (Dynamo 2.13.1.3887)
# author: karam@aecedx.com
# packages: Synthesize toolkit 12.5.1

debug_python_no_message = Custom[Debug Python No Message]()  # package Synthesize toolkit; Debug Python

# group: Input
n01_select_family = DSModelElementSelection()  # "01.Select Family"; nothing selected; graph input
n04_host_width_if_found_0_will = DoubleInput(0)  # "04.Host Width If Found (0 Will Use Default)"; graph input
n06_generic_model_family_template = Filename("..\..\..\ProgramData\Autodesk\RVT 2020\Family Templates\English\Metric Generic Model.rft")  # "06.Generic Model Family Template"; graph input
n07_adaptive_family_template = Filename("..\..\..\ProgramData\Autodesk\RVT 2020\Family Templates\English\Metric Generic Model Adaptive.rft")  # "07.Adaptive Family Template"; graph input
n08_pattern_family_template = Filename("..\..\..\ProgramData\Autodesk\RVT 2020\Family Templates\English\Metric Generic Model Pattern Based.rft")  # "08.Pattern Family Template"; graph input
n02_extra_length_spacing = DoubleInput(0)  # "02.Extra Length Spacing"; graph input
n03_extra_depth_spacing = DoubleInput(0)  # "03.Extra Depth Spacing"; graph input
n05_custom_safe_height_0_will_not = DoubleInput(0)  # "05.Custom Safe Height (0 Will Not Place Invisible Line)"; graph input

smart_rft_path = Custom[Smart RFT Path](VARRFTFile=n06_generic_model_family_template)  # package Synthesize toolkit; Smart RFT Path
categories = Categories("OST_AdaptivePoints")
smart_rft_path_2 = Custom[Smart RFT Path](VARRFTFile=n07_adaptive_family_template, VARCategory=categories)
categories_2 = Categories("OST_CurtainWallPanels")
smart_rft_path_3 = Custom[Smart RFT Path](VARRFTFile=n08_pattern_family_template, VARCategory=categories_2)
k_pattern_family = Custom[K-Pattern Family](VARFamilyInstance=n01_select_family, VARInitialHostWidth=n04_host_width_if_found_0_will, VARFamilyTemplateGenericModels=smart_rft_path, VARFamilyTemplateAdaptive=smart_rft_path_2, VARFamilyTemplatePattern=smart_rft_path_3, VARExtraLength=n02_extra_length_spacing, VARExtraDepth=n03_extra_depth_spacing, VARSafeHeight=n05_custom_safe_height_0_will_not)  # package Synthesize toolkit; K-Pattern Family
