# Dynamo graph Family.K-Patternize UV Size Advisor.dyn (Dynamo 2.13.1.3887)
# author: karam@aecedx.com
# packages: Synthesize toolkit 12.5.1

# group: Input
n01_family_type = FamilyTypes()  # "01.Family Type"; nothing selected; graph input
n02_size_mode_false_u_size_true_v = BoolSelector(false)  # "02.Size Mode: False = U Size | True = V Size"; graph input
n03_desired_size_value = DoubleInput(1)  # "03.Desired Size Value"; graph input

python_script = Python(IN[0]=n01_family_type, IN[1]=n02_size_mode_false_u_size_true_v, IN[2]=n03_desired_size_value)  # IronPython2
# ---------- python_script.python (30 lines) ----------
import clr
clr.AddReference('ProtoGeometry')
from Autodesk.DesignScript.Geometry import *
#The inputs to this node will be stored as a list in the IN variables.
dataEnteringNode = IN

nameparam = UnwrapElement(IN[0]).LookupParameter("K-Pattern Size")
if nameparam != None:
	try:
		name = nameparam.AsString()
		name = name.split("x")
		num1 = float(name[0].strip())
		num2 = float(name[1].strip())
		
		mode = IN[1]
		value = IN[2]
		
		if mode:
			num1 = (value * num1) / num2
			num2 = value
		else:
			num2 = (value * num2) / num1
			num1 = value
		
		#Assign your output to the OUT variable.
		OUT = "U: " + str(round(num1,6)),"V: " + str(round(num2,6))
	except:
		OUT = "Incompatible Family"
else:
	OUT = "Incompatible Family"
# ----------------------------------------

# group: Result
n01_advised_size = Watch(python_script)  # "01.Advised Size"; graph output

code_block = CodeBlock { "Incompatible Family"; null; }
eq = python_script == code_block.out0
scopeIf = Custom[CW.ScopeIf+](VARtest=eq, VARtrue=code_block.out0, VARfalse=code_block.out1)  # package Synthesize toolkit; A (hopefully) more robust implementation of ScopeIf. Tests a single boolean and returns a value accordingly.
alert_popup = Custom[Alert Popup](VARMessage=scopeIf)  # package Synthesize toolkit; Popup a message dialog in Revit
debug_python_no_message = Custom[Debug Python No Message]()  # package Synthesize toolkit; Debug Python
