# Dynamo graph Family.Mirrored Elements Replacement.dyn (Dynamo 2.13.1.3887)
# author: karam@aecedx.com
# packages: Synthesize toolkit 12.5.1

# group: Input
n03_delete_old = BoolSelector(true)  # "03.Delete Old ?"; graph input
n02_auto_place_family_with = BoolSelector(true)  # "02.Auto Place Family With Correct Orientation ?"; graph input
n01_selection_filter_to_read = StringInput("Dynamo Mirrored Elements")  # "01.Selection Filter to Read"; graph input
n04_create_selection_filter_for = BoolSelector(false)  # "04.Create Selection Filter for Newly Created Elements ?"; graph input
n05_filter_name_to_create = StringInput("Dynamo Fixed Mirrored Elements")  # "05.Filter Name to Create"; graph input
n06_overwrite_existing_filter = BoolSelector(false)  # "06.Overwrite Existing Filter ?"; graph input

filter_name_to_create_for = StringInput("Dynamo Mirrored Elements")  # "Filter Name to Create For Mirrored Elements"
overwrite_existing_filter_false = BoolSelector(false)  # "Overwrite Existing Filter ? (False for Adding Elements)"
hot_get_all_filter = Custom[HOT.Get All Filter]()  # package Synthesize toolkit; Get all Filter
eq = hot_get_all_filter.VARName == n01_selection_filter_to_read
filterByBoolMask = List.FilterByBoolMask(list=hot_get_all_filter.VARElement, mask=eq)
elements = Custom[CW.SelectionSet.Elements](VARselectionSet=filterByBoolMask.in)  # package Synthesize toolkit; Retrieves all elements stored in a selection set
flatten = List.Flatten(list=elements)
code_block = CodeBlock { false; }
mirrored_elements_detect = Custom[Mirrored Elements Detect](VARDeleteOldWillNotCreateaSelectionFilterifActivated=n03_delete_old, VARFilterNametoCreate=filter_name_to_create_for, VAROverwriteExistingFilter=overwrite_existing_filter_false, VARAutoPlaceFamilyWithCorrectOrientation=n02_auto_place_family_with, VARElements=flatten, VARCreateSelectionFilter=code_block)  # package Synthesize toolkit; Mirrored Elements Detect
count = List.Count(list=mirrored_elements_detect.VARNewElements)

# group: Report
n01_number_of_mirrored_elements = Watch(mirrored_elements_detect.VARNumberofMirroredElements)  # "01.Number of Mirrored Elements"; graph output
n02_number_of_new_elements = Watch(count)  # "02.Number of New Elements Created"; graph output

generate_selection_filter = Custom[Generate Selection Filter](VARCreateSelectionFilter=n04_create_selection_filter_for, VARFilterNametoCreate=n05_filter_name_to_create, VAROverwriteExistingFilter=n06_overwrite_existing_filter, VARElements=mirrored_elements_detect.VARNewElements)  # package Synthesize toolkit; Generate Selection FIlter
debug_python = Custom[Debug Python]()  # package Synthesize toolkit; Debug Python
