# Dynamo graph Family.Misc Model Text Pull Onto Surfaces.dyn (Dynamo 2.13.1.3887)
# author: karam@aecedx.com
# packages: Synthesize toolkit 12.5.1

# group: Input
n01_select_model_text_facing_face = SelectFaces()  # "01.Select Model Text Facing Face"; nothing selected; graph input
n02_select_faces_to_pull_onto = SelectFaces()  # "02.Select Faces to Pull Onto"; nothing selected; graph input
n03_custom_thickness_0_to = DoubleInput(0)  # "03.Custom Thickness (0 to Autodetect)"; graph input
n04_both_sides = BoolSelector(false)  # "04.Both Sides ?"; graph input
n06_family_name = StringInput("Dynamo Model Text")  # "06.Family Name"; graph input
category = Categories("OST_GenericModel")  # "07.Category"; graph input
n08_family_template_of_the_above = Filename("..\..\..\..\..\..\..\..\..\..\ProgramData\Autodesk\RVT 2020\Family Templates\English\Metric Generic Model.rft")  # "08.Family Template of The Above Category"; graph input
n05_to_void = BoolSelector(false)  # "05.To Void ?"; graph input

code_block = CodeBlock { 2022; }
update_revit_wait = Custom[Update Revit Wait](VARWait=n01_select_model_text_facing_face, VARVersion=code_block)  # package Synthesize toolkit; Update Revit Wait
flatten = List.Flatten(list=update_revit_wait)
fromDynamoSurface = Custom[CW.Element.FromDynamoSurface](VARDynamoSurface=flatten)  # package Synthesize toolkit; Returns the underlying Revit element of a given face
al_duplicate_item_indices = Custom[AL.Duplicate Item Indices](VARList=fromDynamoSurface)  # package Synthesize toolkit; Searches an input list for duplicate entries and lists their index numbers. Couple with Get From List to delete duplicates from a list.
getItemAtIndex = List.GetItemAtIndex(list=flatten, index=al_duplicate_item_indices.VARUniqueIndices)
getItemAtIndex_2 = List.GetItemAtIndex(list=fromDynamoSurface, index=al_duplicate_item_indices.VARUniqueIndices)
isEmpty = List.IsEmpty(list=getItemAtIndex_2, lacing=Longest)
filterByBoolMask = List.FilterByBoolMask(list=getItemAtIndex, mask=isEmpty)
code_block_2 = CodeBlock { 0.1; 1; }
range = Range(end=code_block_2.out1, step=code_block_2.out0, lacing=Longest)
pointAtParameter = Surface.PointAtParameter(surface=filterByBoolMask.in, u=range, v=range, lacing=CrossProduct)
doesIntersect = Geometry.DoesIntersect(geometry=pointAtParameter, other=filterByBoolMask.in)
filterByBoolMask_2 = List.FilterByBoolMask(list=pointAtParameter, mask=doesIntersect)
flatten_2 = List.Flatten(list=filterByBoolMask_2.in@L3)
normalAtPoint = Surface.NormalAtPoint(surface=filterByBoolMask.in, point=flatten_2)
reverse = Vector.Reverse(vector=normalAtPoint)
code_block_3 = CodeBlock { 1; }
current = Document.Current()
activeView = Document.ActiveView(document=current)
byOriginDirection = Revit.References.RayBounce.ByOriginDirection(origin=flatten_2, direction=reverse, maxBounces=code_block_3, view=activeView)
flatten_3 = List.Flatten(list=byOriginDirection.elements@L3)
uniqueItems = List.UniqueItems(list=flatten_3@L2)
python_script = Python(IN[0]=uniqueItems)  # IronPython2
# ---------- python_script.python (22 lines) ----------
import clr
clr.AddReference('ProtoGeometry')
from Autodesk.DesignScript.Geometry import *
#The inputs to this node will be stored as a list in the IN variables.
dataEnteringNode = IN

lists = UnwrapElement(IN[0])

newlist = []
for n in lists:
	tmp = []
	for l in n:
		if hasattr(l, "Symbol"):
			tmp.append(l)
	try:
		newlist.append(tmp[0])
	except:
		newlist.append(tmp)
		

#Assign your output to the OUT variable.
OUT = newlist
# ----------------------------------------
filterByBoolMask_3 = List.FilterByBoolMask(list=getItemAtIndex_2, mask=isEmpty)
mergeByBoolMask = Custom[SP.List.MergeByBoolMask](VARIn=python_script, VAROut=filterByBoolMask_3.out, VARmask=isEmpty)  # package Synthesize toolkit; Merge two lists by a boolean mask list. The true count in the mask should be the same as the length of the true list and vice versa for the false list.
element_geometry_fixer = Custom[Element.Geometry Fixer](VARElement=mergeByBoolMask)  # package Synthesize toolkit; Element.Geometry Fixer
python_script_2 = Python(IN[0]=element_geometry_fixer)  # IronPython2
# ---------- python_script_2.python (19 lines) ----------
# Load the Python Standard and DesignScript Libraries
import sys
import clr
clr.AddReference('ProtoGeometry')
from Autodesk.DesignScript.Geometry import *

# The inputs to this node will be stored as a list in the IN variables.
dataEnteringNode = IN
lists = IN[0]

result = []
for list in lists:
	tmp  = []
	for l in list:
		tmp.append(Solid.Separate(l))
	result.append(tmp)
		
# Assign your output to the OUT variable.
OUT = result
# ----------------------------------------
flatten_4 = List.Flatten(list=python_script_2@L2)
explode = Geometry.Explode(geometry=flatten_4)
code_block_4 = CodeBlock { 0.5; }
pointAtParameter_2 = Surface.PointAtParameter(surface=getItemAtIndex, u=code_block_4, v=code_block_4)
normalAtPoint_2 = Surface.NormalAtPoint(surface=getItemAtIndex, point=pointAtParameter_2)
byOriginNormal = Plane.ByOriginNormal(origin=pointAtParameter_2, normal=normalAtPoint_2)
code_block_5 = CodeBlock { 0.5; }
pointAtParameter_3 = Surface.PointAtParameter(surface=explode, u=code_block_5, v=code_block_5)
doesIntersect_2 = Geometry.DoesIntersect(geometry=byOriginNormal, other=pointAtParameter_3)
filterByBoolMask_4 = List.FilterByBoolMask(list=explode, mask=doesIntersect_2)
flatten_5 = List.Flatten(list=n02_select_faces_to_pull_onto)
code_block_6 = CodeBlock { 0.5; }
pointAtParameter_4 = Surface.PointAtParameter(surface=getItemAtIndex, u=code_block_6, v=code_block_6)
count = List.Count(list=pointAtParameter_4)
ofRepeatedItem = List.OfRepeatedItem(item=flatten_5, amount=count)
distanceTo = Geometry.DistanceTo(geometry=pointAtParameter_4@L1, other=flatten_5)
minimumItem = List.MinimumItem(list=distanceTo)
eq = distanceTo == minimumItem
filterByBoolMask_5 = List.FilterByBoolMask(list=ofRepeatedItem, mask=eq)
byGeometry = BoundingBox.ByGeometry(geom=filterByBoolMask_5.in)
dimensions = Custom[ZK.BoundingBox.Dimensions](VARBoundingBox=byGeometry)  # package Synthesize toolkit; Input Bounding Box element to get its dimensions (Width, Length, Height). Setting Boolean switch to True rounds output values.
create = List.Create(item0=dimensions.VARWidth, item1=dimensions.VARLength, item2=dimensions.VARHeight)
transpose = List.Transpose(lists=create)
maximumItem = List.MaximumItem(list=transpose)
thicken = Surface.Thicken(surface=filterByBoolMask_4.in, thickness=maximumItem)
flatten_6 = List.Flatten(list=filterByBoolMask_5.in)
intersect = Geometry.Intersect(geometry=thicken, other=flatten_6)
flatten_7 = List.Flatten(list=intersect@L4)
code_block_7 = CodeBlock { 0; }
eq_2 = n03_custom_thickness_0_to == code_block_7
perimeterCurves = Surface.PerimeterCurves(surface=filterByBoolMask_4.in)
startPoint = Curve.StartPoint(curve=perimeterCurves)
firstItem = List.FirstItem(list=startPoint@@L2)
firstItem_2 = List.FirstItem(list=firstItem@@L2)
firstItem_3 = List.FirstItem(list=filterByBoolMask_4.in@@L2)
normalAtPoint_3 = Surface.NormalAtPoint(surface=firstItem_3, point=firstItem_2)
reverse_2 = Vector.Reverse(vector=normalAtPoint_3)
byStartPointDirectionLength = Line.ByStartPointDirectionLength(startPoint=firstItem_2, direction=reverse_2, length=maximumItem)
doesIntersect_3 = Geometry.DoesIntersect(geometry=explode, other=byStartPointDirectionLength)
filterByBoolMask_6 = List.FilterByBoolMask(list=explode, mask=doesIntersect_3)
distanceTo_2 = Geometry.DistanceTo(geometry=filterByBoolMask_6.in, other=firstItem_2)
maximumItem_2 = List.MaximumItem(list=distanceTo_2)
code_block_8 = CodeBlock { 2; }
mul = maximumItem_2 * code_block_8
scopeIf = Custom[CW.ScopeIf+](VARtest=n04_both_sides, VARtrue=mul, VARfalse=maximumItem_2)  # package Synthesize toolkit; A (hopefully) more robust implementation of ScopeIf. Tests a single boolean and returns a value accordingly.
scopeIf_2 = Custom[CW.ScopeIf+](VARtest=eq_2, VARtrue=scopeIf, VARfalse=n03_custom_thickness_0_to)
python_script_3 = Python(IN[0]=flatten_7, IN[1]=scopeIf_2, IN[2]=n04_both_sides)  # IronPython2
# ---------- python_script_3.python (449 lines) ----------
# Created By Karam Baki, karam@aecedx.com

import clr
import System

pf_path = System.Environment.GetFolderPath(System.Environment.SpecialFolder.ProgramFilesX86)
import sys
sys.path.append('%s\IronPython 2.7\Lib' %pf_path)
import traceback
import random
import string

clr.AddReference('ProtoGeometry')
from Autodesk.DesignScript.Geometry import *

clr.AddReference('RevitServices')
import RevitServices
from RevitServices.Persistence import DocumentManager
from RevitServices.Transactions import TransactionManager
doc = DocumentManager.Instance.CurrentDBDocument

clr.AddReference('RevitAPI')
from Autodesk.Revit.DB import *
from Autodesk.Revit.DB.Structure import StructuralType

from Autodesk.DesignScript import Geometry as dg

clr.AddReference('RevitNodes')
import Revit
clr.ImportExtensions(Revit.Elements)
clr.ImportExtensions(Revit.GeometryConversion)

import math

def flatten(x):
    result = []
    for el in x:
        if hasattr(el, "__iter__") and not isinstance(el, basestring):
            result.extend(flatten(el))
        else:
            result.append(el)
    return result

def tolist(obj1):
	if hasattr(obj1,'__iter__'): return obj1
	else: return [obj1]

def recreatesurfaces(surfaces,RevitCheck=True,ForceRecreate=False):
	class WarnSwallowImport(IFailuresPreprocessor):
		def PreprocessFailures(self, failuresAccessor):
			failuresAccessor.DeleteAllWarnings()
			return FailureProcessingResult.Continue
	def flatten(x):
	    result = []
	    for el in x:
	        if hasattr(el, "__iter__") and not isinstance(el, basestring):
	            result.extend(flatten(el))
	        else:
	            result.append(el)
	    return result
	
	def tolist(obj1):
		if hasattr(obj1,'__iter__'): return obj1
		else: return [obj1]
	def cleanupSurface(surface):
		def isActuallygood(geomorsat,converted):
			geometrymode = True
			originalfaces = []
			if isinstance(geomorsat,dg.Solid) or isinstance(geomorsat,dg.PolySurface):
				exploded = dg.Geometry.Explode(geomorsat)
				for exp in exploded:
					originalfaces.append(exp)
					if exp.Closed:
						originalfaces.append(exp)
			elif isinstance(geomorsat,dg.Surface):
				if geometrymode == False:
					originalfaces.append(geomorsat)
					if geomorsat.Closed:
						originalfaces.append(geomorsat)
				else:
					exploded = dg.Geometry.Explode(geomorsat)
					for exp in exploded:
						originalfaces.append(exp)
						if exp.Closed:
							originalfaces.append(exp)
			elif isinstance(geomorsat,str):
				geomsorsat = dg.Geometry.ImportFromSAT(geomorsat)
				for geomorsat in geomsorsat:
					if isinstance(geomorsat,dg.Solid) or isinstance(geomorsat,dg.PolySurface):
						exploded = dg.Geometry.Explode(geomorsat)
						for exp in exploded:
							originalfaces.append(exp)
							if exp.Closed:
								originalfaces.append(exp)
						if geometrymode == False and doc.IsFamilyDocument:
							geomorsat.Dispose()
					elif isinstance(geomorsat,dg.Surface):
						if geometrymode == False:
							originalfaces.append(geomorsat)
							if geomorsat.Closed:
								originalfaces.append(geomorsat)
						else:
							exploded = dg.Geometry.Explode(geomorsat)
							for exp in exploded:
								originalfaces.append(exp)
								if exp.Closed:
									originalfaces.append(exp)
				if geometrymode:
					geomorsat = list(geomsorsat)
			originalnum = len(originalfaces)
			for org in originalfaces:
				org.Dispose()
			FFfaces = []
			for e in converted:
				getfaces = e.Faces
				for gotten in getfaces:
					FFfaces.append(gotten)
			FFfacesnum = len(FFfaces)
			if FFfacesnum >= originalnum:
				samefaces = True
			else:
				samefaces = False
			return samefaces
		def checkcompatible(geoms,RevitCheck):
			if RevitCheck == False:
				return True
			randomname = ''.join([random.choice(string.ascii_letters + string.digits) for n in xrange(5)])
			sat_path = '%s%s.sat' % (temp_path, randomname)
			dg.Geometry.ExportToSAT(geoms,sat_path)
			converted = []
			shapeImporter = ShapeImporter()
			converted = list(shapeImporter.Convert(doc, sat_path))
			shapeImporter.Dispose()
			System.IO.File.Delete(sat_path)
			for e in converted:
				if e.ToString() == "Autodesk.Revit.DB.Mesh":
					return False
			if len(converted) != 0:
				converted = isActuallygood(geoms,converted)
			return converted
		def meternumber(value):
			value = value
			return value
		def metersurfarea(surface):
			area = meternumber(surface.Area)
			return area
		def almostsame(surf1,surf2,tollerance = 3):
			if round(metersurfarea(surf1),tollerance) == round(metersurfarea(surf2),tollerance):
				return True
			else:
				return False
		def subtractfunction(nurbs,cleanexplodes):
			def loopclean(nurbs,thick,counter):
				result = dg.Surface.SubtractFrom(nurbs,thick)[0]
				if counter != 0:
					nurbs.Dispose()
				thick.Dispose()
				return result
			thickforms = []
			for cleanex in cleanexplodes:
				safearea = metersurfarea(cleanex)/10
				if safearea > meternumber(0.1):
					maxthicken = meternumber(0.1)
				else:
					maxthicken = safearea
				thickforms.append(dg.Surface.Thicken(cleanex,maxthicken,True))
			counter = 0
			for thick in thickforms:
				nurbs = loopclean(nurbs,thick,counter)
				counter += 1
			return nurbs
		def tryingforall(surface,nurbs,cleanexplodes,geometrymode):
			try:
				finalsub = subtractfunction(nurbs,cleanexplodes)
				return [finalsub]
			except:
				try:
					finalsub = dg.Surface.Difference(nurbs,cleanexplodes)
					return [finalsub]
				except Exception as e:
					if str(e) == "Cannot difference an empty list" and almostsame(nurbs,surface):
						finalsub = nurbs
						try:
							return [finalsub]
						except:
							return None
		def gencleanexplodes(subtractnurbs):
			if isinstance(subtractnurbs, list):
				if len(subtractnurbs) == 0:
					return []
			else:
				explodednurbs = dg.Geometry.Explode(subtractnurbs)
				cleanexplodes = []
				if safemode:
					for ex in explodednurbs:
						if ex.Area < meternumber(0.002):
							ex.Dispose()
						else:
							cleanexplodes.append(ex)
				else:
					cleanexplodes = list(explodednurbs)
				subtractnurbs.Dispose()
				return cleanexplodes
		def easymethod(surface,geometrymode):
			try:
				nurbs = dg.Surface.ToNurbsSurface(surface)
				if almostsame(nurbs,surface):
					try:
						return True,[nurbs]
					except:
						return None,nurbs
				else:
					return None,nurbs
			except:
				return None,None
		def isplanarsurf(s):
			norms = [0,0.333,0.666,1]
			pts = []
			for n in norms:
				for n2 in norms:
					pts.append(dg.Surface.PointAtParameter(s,n,n2))
			plane = dg.Plane.ByBestFitThroughPoints(pts)
			status = True
			for p in pts:
				try:
					inter = dg.Geometry.DoesIntersect(p,plane)
					if inter == False:
						status = False
						break
				except:
					pass
			return status
		def joincurves(crvs):
			def PointsEqual(pt1, pt2):
				tolerance = 0.00001
				if (math.fabs(pt1.X - pt2.X) < tolerance and
					math.fabs(pt1.Y - pt2.Y) < tolerance and
					math.fabs(pt1.Z - pt2.Z) < tolerance):
					return True
				else:
					return False
			crvs = flatten(tolist(crvs))
			crvGroup = [-1 for x in range(len(crvs))]
			crvGroup[0] = 0
			maxGroupNum = 1
			starts = []
			ends = []
			for crv in crvs:
				starts.append(crv.PointAtParameter(0))
				ends.append(crv.PointAtParameter(1))
			for i in range(len(crvs)):
				if (crvGroup[i] == -1):
					crvGroup[i] = i
				for j in range(len(crvs)):
					if (i != j and
						(PointsEqual(starts[i], starts[j]) or
						PointsEqual(starts[i], ends[j]) or
						PointsEqual(ends[i], starts[j]) or
						PointsEqual(ends[i], ends[j]))):
						if (crvGroup[j] == -1):
							crvGroup[j] = crvGroup[i]
						elif (crvGroup[i] != crvGroup[j]):
							oldNum = crvGroup[j]
							for k in range(len(crvs)):
								if (crvGroup[k] == oldNum):
									crvGroup[k] = crvGroup[i]
			groups = []
			excluded = []
			for n in crvGroup:
				innercount = 0
				tmp = []
				for n2 in crvGroup:
					if n == n2 and n2 not in excluded:
						tmp.append(crvs[innercount])
					innercount += 1
				if len(tmp) == 0:
					continue
				try:
					tmp = dg.PolyCurve.ByJoinedCurves(tmp)
					groups.append(tmp)
				except:
					for t in tmp:
						groups.append(dg.PolyCurve.ByJoinedCurves([t]))
				excluded.append(n)
			joinedcurves = groups
			return joinedcurves
		def trimloopmethod(surface,nurbs,geometrymode):
			try:
				if surface.Closed:
					return None
				try:
					joinedperms = [dg.PolyCurve.ByJoinedCurves(surface.PerimeterCurves())]
				except:
					joinedperms = joincurves(surface.PerimeterCurves())
				finalsub = dg.Surface.TrimWithEdgeLoops(nurbs,joinedperms)
				if almostsame(finalsub,surface):
					return [finalsub]
				else:
					return None
			except:
				return None
		def thickenintersectMethod(surface,nurbs,geometrymode,pointOneMeter):
			try:
				tmp_thicken = dg.Surface.Thicken(surface,pointOneMeter,True)
				isplanar = isplanarsurf(surface)
				if isplanar:
					tmp_pt = dg.Surface.PointAtParameter(surface,0.5,0.5)
					tmp_norm = dg.Surface.NormalAtPoint(surface,tmp_pt)
					intersecter = dg.Plane.ByOriginNormal(tmp_pt,tmp_norm)
					finalsub = dg.Geometry.Intersect(intersecter,tmp_thicken)
					for f in finalsub:
						if isinstance(f,dg.Surface):
							finalsub = f
							break
					tmp_thicken.Dispose()
				else:
					finalsub = dg.Geometry.Intersect(nurbs,tmp_thicken)
					for f in finalsub:
						if isinstance(f,dg.Surface):
							finalsub = f
							break
					tmp_thicken.Dispose()
				return [finalsub]
			except:
				return None
		def inithickenMethod(surface,nurbs,geometrymode):
			try:
				safearea = metersurfarea(surface)/10
				if safearea > meternumber(0.1):
					maxthicken = meternumber(0.1)
				else:
					maxthicken = safearea
				thickeninit = dg.Surface.Thicken(surface,maxthicken,True)
				try:
					subtractnurbs = dg.Surface.SubtractFrom(nurbs,thickeninit)[0]
				except Exception as e:
					if "index out of range" in str(e) and almostsame(nurbs,surface):
						subtractnurbs = []
					elif "index out of range" in str(e):
						try:
							subtractnurbs = dg.Surface.Difference(nurbs,[surface])
						except Exception as e:
							if str(e) == "Unable to get FACE from BODY: no faces in BODY":
								subtractnurbs = []
				thickeninit.Dispose()
				cleanexplodes = gencleanexplodes(subtractnurbs)
				tryall = tryingforall(surface,nurbs,cleanexplodes,geometrymode)
				if tryall != None:
					return tryall
				else:
					return None
			except:
				return None
		def simplesubmethod(surface,nurbs,geometrymode):
			try:
				try:
					subtractnurbs = dg.Surface.Difference(nurbs,[surface])
				except Exception as e:
					if str(e) == "Unable to get FACE from BODY: no faces in BODY":
						try:
							return [nurbs]
						except:
							return None
				cleanexplodes = gencleanexplodes(subtractnurbs)
				tryall = tryingforall(surface,nurbs,cleanexplodes,geometrymode)
				if tryall != None:
					return tryall
				else:
					return None
			except:
				return None
		geometrymode = True
		safemode = False
		pointOneMeter = 0.1
		if ForceRecreate == False:
			if checkcompatible(surface,RevitCheck):
				return surface
		easy = easymethod(surface,geometrymode)
		if easy[0] != None:
			return easy[1][0]
		elif easy[0] == None and easy[1] == None:
			return surface
		else:
			nurbs = easy[1]
		#trimloop = trimloopmethod(surface,nurbs,geometrymode)
		#if trimloop != None:
		#	if checkcompatible(trimloop[0],RevitCheck):
		#		return trimloop[0]
		simple = simplesubmethod(surface,nurbs,geometrymode)
		if simple != None:
			if checkcompatible(simple[0],RevitCheck):
				return simple[0]
		inithick = inithickenMethod(surface,nurbs,geometrymode)
		if inithick != None:
			if checkcompatible(inithick[0],RevitCheck):
				return inithick[0]
		thickeninter = thickenintersectMethod(surface,nurbs,geometrymode,pointOneMeter)
		if thickeninter != None:
			if checkcompatible(thickeninter[0],RevitCheck):
				return thickeninter[0]
		return surface
	
	TransactionManager.Instance.ForceCloseTransaction()
	trans = Transaction(doc, 'Temporary Transaction')
	trans.Start()
	warnhandle = WarnSwallowImport()
	foptions = trans.GetFailureHandlingOptions()
	foptions.SetFailuresPreprocessor(warnhandle)
	foptions.SetClearAfterRollback(True)
	trans.SetFailureHandlingOptions(foptions)
	temp_path = System.IO.Path.GetTempPath()
	surfaces = flatten(tolist(surfaces))
	cleanedsurfs = []
	for s in surfaces:
		cleanedsurfs.append(cleanupSurface(s))
	surfaces = cleanedsurfs
	trans.RollBack()
	return surfaces
		
surfaceslists = IN[0]
thickenlists = IN[1]
bothsides = IN[2]

result = []
bigcount = 0
for surfaces in surfaceslists:
	thicken = thickenlists[bigcount]
	bigcount += 1
	cleanedsurfs = []
	count = 0
	surfaces = recreatesurfaces(surfaces)
	for s in surfaces:
		thick = thicken[count]
		count += 1
		try:
			cleanedsurfs.append(dg.Surface.Thicken(s,thick,bothsides))
		except:
			oldvec = dg.Surface.NormalAtParameter(s,0.5,0.5)
			cleans = recreatesurfaces(s,True,True)[0]
			newvec = dg.Surface.NormalAtParameter(cleans,0.5,0.5)
			if dg.Vector.IsAlmostEqualTo(oldvec,newvec) == False and dg.Vector.IsAlmostEqualTo(oldvec.Reverse(),newvec):
				thick = -thick
			try:
				cleanedsurfs.append(dg.Surface.Thicken(cleans,thick,bothsides))
			except:
				cleanedsurfs.append(None)
	result.append(cleanedsurfs)
	
OUT = result
# ----------------------------------------
smart_rft_path = Custom[Smart RFT Path](VARRFTFile=n08_family_template_of_the_above)  # package Synthesize toolkit; Smart RFT Path
k_family_insert = Custom[K-Family Insert](VARGeometryorSAT=python_script_3@L2, VARFamilyName=n06_family_name, VARFamilyCategory=category, VARFamilyTemplatePath=smart_rft_path, VARToVoid=n05_to_void)  # package Synthesize toolkit; K-Family Insert
code_block_9 = CodeBlock { "Material"; }
getMaterials = Element.GetMaterials(element=mergeByBoolMask)
python_empty_2_null = Custom[Python Empty 2 Null](VARIN=getMaterials)  # package Synthesize toolkit; Python Null 2 Empty
code_block_10 = CodeBlock { 2; }
normalizeDepth = List.NormalizeDepth(list=python_empty_2_null, rank=code_block_10)
firstItem_4 = List.FirstItem(list=normalizeDepth@L2)
element_setparameterbyname_fixer = Custom[Element.SetParameterByName Fixer](VARelement=k_family_insert.VARFamilyInstancesOrImportSymbols, VARparameterName=code_block_9, VARvalue=firstItem_4)  # package Synthesize toolkit; Element.SetParameterByName Fixer
debug_python_no_message = Custom[Debug Python No Message]()  # package Synthesize toolkit; Debug Python
