# Dynamo graph Family.Names Add Prefix and Suffix.dyn (Dynamo 2.13.1.3887)
# author: karam@aecedx.com

prefix = StringInput("MYPRE-")  # "01.Prefix"; graph input
suffix = StringInput("-MYSUFF")  # "02.Suffix"; graph input
category = Categories("OST_Doors")  # "03.Category"; graph input
n04_include_all_categories_false = BoolSelector(false)  # "04.Include All Categories ? (False Affects Only The Category above)"; graph input
n05_include_materials = BoolSelector(false)  # "05.Include Materials ?"; graph input
n06_include_fill_patterns = BoolSelector(false)  # "06.Include Fill Patterns ?"; graph input
n07_include_linestyles = BoolSelector(false)  # "07.Include Linestyles ?"; graph input
n08_existed_prefix_to_remove = StringInput("")  # "08.Existed Prefix to Remove"; graph input
n09_existed_suffix_to_remove = StringInput("")  # "09.Existed Suffix to Remove"; graph input
python_script = Python(IN[0]=prefix, IN[1]=suffix, IN[2]=category, IN[3]=n04_include_all_categories_false, IN[4]=n05_include_materials, IN[5]=n06_include_fill_patterns, IN[6]=n07_include_linestyles, IN[7]=n08_existed_prefix_to_remove, IN[8]=n09_existed_suffix_to_remove)  # IronPython2
# ---------- python_script.python (100 lines) ----------
# Created by Karam Baki: karam@aecedx.com
import clr
clr.AddReference('RevitAPI')
from Autodesk.Revit.DB import *
clr.AddReference('RevitServices')
from RevitServices.Persistence import DocumentManager
from RevitServices.Transactions import TransactionManager

def nameHandle(each,pre,suf,preRem,sufRem):
	try:
		toSet = each.Name
	except:
		try:
			toSet = each.LookupParameter("Type Name").AsString()
		except:
			return None
	if preRem != "":
		if toSet.startswith(preRem):
			toSet = toSet[len(preRem):]
	if toSet.startswith(pre) == False:
		toSet = pre + toSet
	if sufRem != "":
		if toSet.endswith(sufRem):
			toSet = toSet[:-len(sufRem)]
	if toSet.endswith(suf) == False:
		toSet = toSet + suf
	return toSet
	
class KaramWarningIgnore(IFailuresPreprocessor):
	def PreprocessFailures(self, failuresAccessor):
		failuresAccessor.DeleteAllWarnings()
		return FailureProcessingResult.Continue
		
doc = DocumentManager.Instance.CurrentDBDocument
pre = IN[0]
suf = IN[1]
cat = UnwrapElement(IN[2])
mega = IN[3]
mats = IN[4]
fillpats = IN[5]
linestyles = IN[6]
preRem = IN[7]
sufRem = IN[8]

if mega:
	types = list(FilteredElementCollector(doc).WhereElementIsElementType().ToElements())
else:
	types = list(FilteredElementCollector(doc).OfCategoryId(cat.Id).WhereElementIsElementType().ToElements())
famIds = []

for type in types:
	try:
		famIds.append(type.Family.Id)
	except:
		pass
famIds = list(set(famIds))
fams = []

for famId in famIds:
	fams.append(doc.GetElement(famId))
	
all = types + fams
TransactionManager.Instance.ForceCloseTransaction()
trans = Transaction(doc, 'Change Family and Type Names')
trans.Start()
warnhandle = KaramWarningIgnore()
foptions = trans.GetFailureHandlingOptions()
foptions.SetFailuresPreprocessor(warnhandle)
foptions.SetClearAfterRollback(True)
trans.SetFailureHandlingOptions(foptions)

types = []
success = []
if mats or cat.BuiltInCategory == BuiltInCategory.OST_Materials:
	all += list(FilteredElementCollector(doc).OfClass(Material).ToElements())
	
if fillpats:
	all += list(FilteredElementCollector(doc).OfClass(FillPatternElement).ToElements())
	
if linestyles:
	linestyleCat = doc.Settings.Categories.get_Item(BuiltInCategory.OST_Lines)
	linestyleSubs = linestyleCat.SubCategories
	for linestyle in linestyleSubs:
		lineStyleElement = doc.GetElement(linestyle.Id)
		if lineStyleElement != None:
			all.append(lineStyleElement)
			
for each in all:
	toSet = nameHandle(each,pre,suf,preRem,sufRem)
	if toSet == None:
		continue
	try:
		each.Name = toSet
		success.append(each)
	except:
		pass
		
trans.Commit()

OUT = success
# ----------------------------------------
