# Dynamo graph Family.Refine Level and Offset By Family and Type.dyn (Dynamo 2.13.1.3887)
# author: karam@aecedx.com
# packages: Synthesize toolkit 12.5.1

debug_python = Custom[Debug Python]()  # package Synthesize toolkit; Debug Python

# group: Input
n02_all_elements_of_family_name = BoolSelector(true)  # "02.All Elements of Family Name (All types) ?"; graph input
n01_family_names_separate_by = StringInput("Family")  # "01.Family Names (Separate By Comma , - or * To Select All Matching)"; graph input
n03_specific_type_names_separate = StringInput("Type")  # "03.Specific Type Names (Separate by Comma , )"; graph input
n04_elements_in_active_view_only = BoolSelector(false)  # "04.Elements In Active View Only ?"; graph input
n06_loadable_level_parameter = StringInput("Level")  # "06.Loadable : Level Parameter"; graph input
n07_loadable_offset_parameter = StringInput("Offset")  # "07.Loadable : Offset Parameter"; graph input
n05_system_refine_walls_top = BoolSelector(false)  # "05.System : Refine Walls Top Constraints"; graph input

code_block = CodeBlock { ","; }
family_and_type_selector = Custom[Family and Type Selector](VARAllElementsofFamilyNameAlltypes=n02_all_elements_of_family_name, VARFamilyName=n01_family_names_separate_by, VARSpecificTypeNamesSeparatebySymbol=n03_specific_type_names_separate, VARSeparationSymbol=code_block, VAROnlyInActiveView=n04_elements_in_active_view_only)  # package Synthesize toolkit; Family and Type Selector
refine_families = Custom[Refine Families](VARElements=family_and_type_selector.VARElements, VARLoadablLevelParameter=n06_loadable_level_parameter, VARLoadablOffsetParameter=n07_loadable_offset_parameter, SystemRefineWallTopConstraints=n05_system_refine_walls_top)  # package Synthesize toolkit; Refine Families
