# Dynamo graph Family.Refine Level and Offset By Selection Filter.dyn (Dynamo 2.13.1.3887)
# author: karam@aecedx.com
# packages: Synthesize toolkit 12.5.1

debug_python = Custom[Debug Python]()  # package Synthesize toolkit; Debug Python
hot_get_all_filter = Custom[HOT.Get All Filter]()  # package Synthesize toolkit; Get all Filter
toLower = String.ToLower(string=hot_get_all_filter.VARName)
trimWhitespace = String.TrimWhitespace(string=toLower)

# group: Input
n01_elements_selection_filter_to = StringInput("Selection Filter")  # "01.Elements Selection Filter to Read"; graph input
n03_loadable_level_parameter = StringInput("Level")  # "03.Loadable : Level Parameter"; graph input
n04_loadable_offset_parameter = StringInput("Offset")  # "04.Loadable : Offset Parameter"; graph input
n02_system_refine_walls_top = BoolSelector(false)  # "02.System : Refine Walls Top Constraints"; graph input

toLower_2 = String.ToLower(string=n01_elements_selection_filter_to)
trimWhitespace_2 = String.TrimWhitespace(string=toLower_2)
eq = trimWhitespace == trimWhitespace_2
filterByBoolMask = List.FilterByBoolMask(list=hot_get_all_filter.VARElement, mask=eq)
elements = Custom[CW.SelectionSet.Elements](VARselectionSet=filterByBoolMask.in)  # package Synthesize toolkit; Retrieves all elements stored in a selection set
flatten = List.Flatten(list=elements)
code_block = CodeBlock { false; }
clean = List.Clean(list=flatten, preserveIndices=code_block)
flatten_2 = List.Flatten(list=clean)
refine_families = Custom[Refine Families](VARElements=flatten_2, VARLoadablLevelParameter=n03_loadable_level_parameter, VARLoadablOffsetParameter=n04_loadable_offset_parameter, SystemRefineWallTopConstraints=n02_system_refine_walls_top)  # package Synthesize toolkit; Refine Families
