# Dynamo graph Family.Rotate By Family and Type.dyn (Dynamo 2.13.1.3887)
# author: karam@aecedx.com
# packages: Synthesize toolkit 12.5.1

# group: Input
n02_all_elements_of_family_name = BoolSelector(true)  # "02.All Elements of Family Name (All types) ?"; graph input
n01_family_names_separate_by = StringInput("Family")  # "01.Family Names (Separate By Comma , - or * To Select All Matching)"; graph input
n03_specific_type_names_separate = StringInput("Type")  # "03.Specific Type Names (Separate by Comma , )"; graph input
n04_elements_in_active_view_only = BoolSelector(false)  # "04.Elements In Active View Only ?"; graph input
n07_randomize_rotaions = BoolSelector(false)  # "07.Randomize Rotaions ?"; graph input
n05_additive_adds_rotation_to = BoolSelector(false)  # "05.Additive (Adds Rotation to Existed Value) ?"; graph input
n08_minimum_random_rotation_angle = DoubleSlider(0, range=-360..360 step 1)  # "08.Minimum Random Rotation Angle (Useful When Randomize Rotations is Activated)"; graph input
n09_maximum_random_rotation_angle = DoubleSlider(360, range=-360..360 step 1)  # "09.Maximum Random Rotation Angle (Useful When Randomize Rotations is Activated)"; graph input
degree = DoubleInput(0)  # "06.Degree"; graph input

code_block = CodeBlock { ","; }
family_and_type_selector = Custom[Family and Type Selector](VARAllElementsofFamilyNameAlltypes=n02_all_elements_of_family_name, VARFamilyName=n01_family_names_separate_by, VARSpecificTypeNamesSeparatebySymbol=n03_specific_type_names_separate, VARSeparationSymbol=code_block, VAROnlyInActiveView=n04_elements_in_active_view_only)  # package Synthesize toolkit; Family and Type Selector
family_smart_rotation = Custom[Family Smart Rotation](VARFamilyInstance=family_and_type_selector.VARElements, VARRandomizeRotaions=n07_randomize_rotaions, VARAdditiveAddsRotationtoExistedValue=n05_additive_adds_rotation_to, VARMinimumRnadomRotationAngleUsefulWhenRandomizeRotationsisActivated=n08_minimum_random_rotation_angle, VARMaximumRandomRotationAngleUsefulWhenRandomizeRotationsisActivated=n09_maximum_random_rotation_angle, VARDegree=degree)  # package Synthesize toolkit; Family Smart Rotation
debug_python = Custom[Debug Python]()  # package Synthesize toolkit; Debug Python
