# Dynamo graph Family.Rotate By Selection.dyn (Dynamo 2.13.1.3887)
# author: karam@aecedx.com
# packages: Synthesize toolkit 12.5.1

rh_pick_model_elements = Custom[RH.Pick Model Elements]()  # package Synthesize toolkit; This node offers a pick method for selecting elements in Revit.

# group: Input
n03_randomize_rotaions = BoolSelector(false)  # "03.Randomize Rotaions ?"; graph input
n01_additive_adds_rotation_to = BoolSelector(false)  # "01.Additive (Adds Rotation to Existed Value) ?"; graph input
n04_minimum_random_rotation_angle = DoubleSlider(0, range=-360..360 step 1)  # "04.Minimum Random Rotation Angle (Useful When Randomize Rotations is Activated)"; graph input
n05_maximum_random_rotation_angle = DoubleSlider(360, range=-360..360 step 1)  # "05.Maximum Random Rotation Angle (Useful When Randomize Rotations is Activated)"; graph input
degree = DoubleInput(0)  # "02.Degree"; graph input

family_smart_rotation = Custom[Family Smart Rotation](VARFamilyInstance=rh_pick_model_elements, VARRandomizeRotaions=n03_randomize_rotaions, VARAdditiveAddsRotationtoExistedValue=n01_additive_adds_rotation_to, VARMinimumRnadomRotationAngleUsefulWhenRandomizeRotationsisActivated=n04_minimum_random_rotation_angle, VARMaximumRandomRotationAngleUsefulWhenRandomizeRotationsisActivated=n05_maximum_random_rotation_angle, VARDegree=degree)  # package Synthesize toolkit; Family Smart Rotation
debug_python = Custom[Debug Python]()  # package Synthesize toolkit; Debug Python
