# Dynamo graph Family.Scatter By Area Plans.dyn (Dynamo 2.13.1.3887)
# author: karam@aecedx.com
# packages: Synthesize toolkit 12.5.1

categories = Categories("OST_Areas")
all_elements_of_category = ElementsOfCategory(Category=categories)
python_all_elements_in_active = Custom[Python All Elements In Active View]()  # package Synthesize toolkit; Python All Elements In Active View
python_filter_list_from_another = Custom[Python Filter List From Another List](VARItemsToFilter=all_elements_of_category, VARAllItemsToFilterFrom=python_all_elements_in_active)  # package Synthesize toolkit; Find Intersections In Lists

# group: Input
n01_dynamo_filter_parameter = StringInput("Is Area Scatter")  # "01.Dynamo Filter Parameter"; graph input
n03_spacing_parameter = StringInput("Area Spacing")  # "03.Spacing Parameter"; graph input
n02_family_type_parameter = StringInput("Family Type Parameter")  # "02.Family Type Parameter"; graph input
n08_force_placement_without_check = BoolSelector(false)  # "08.Force Placement Without Check Existing Families (Might result in duplicates)"; graph input
n04_offset_parameter = StringInput("Area Offset")  # "04.Offset Parameter"; graph input
n07_overriden_offset_value_from = DoubleInput(-1.5)  # "07.Overriden Offset Value From Borders for Empty Inputs"; graph input
n05_rotation_parameter = StringInput("Area Rotation")  # "05.Rotation Parameter"; graph input
n06_rotation_angle_to_add_added = DoubleInput(45)  # "06.Rotation Angle to Add (Added to Value of Rotation Parameter)"; graph input
n09_create_selection_filter = BoolSelector(true)  # "09.Create Selection Filter ?"; graph input
n10_filter_name_to_create = StringInput("Dynamo Scattered Elements By Area Plans")  # "10.Filter Name to Create"; graph input
n11_overwrite_existing_filter = BoolSelector(false)  # "11.Overwrite Existing Filter ? (False for Adding Elements)"; graph input

getParameterValueByName = Element.GetParameterValueByName(element=python_filter_list_from_another, parameterName=n01_dynamo_filter_parameter)
code_block = CodeBlock { 1; }
eq = getParameterValueByName == code_block
filterByBoolMask = List.FilterByBoolMask(list=python_filter_list_from_another, mask=eq)
getParameterValueByName_2 = Element.GetParameterValueByName(element=filterByBoolMask.in, parameterName=n03_spacing_parameter)
code_block_2 = CodeBlock { ""; }
eq_2 = getParameterValueByName_2 == code_block_2
filterByBoolMask_2 = List.FilterByBoolMask(list=filterByBoolMask.in, mask=eq_2)
getParameterValueByName_3 = Element.GetParameterValueByName(element=filterByBoolMask_2.out, parameterName=n02_family_type_parameter)
eq_3 = getParameterValueByName_3 == code_block_2
anyTrue = Custom[CW.List.AnyTrue](VARseq=eq_3)  # package Synthesize toolkit; Returns true if any item in a list of booleans is true.
code_block_3 = CodeBlock { "One or More Family Types are Not Defined, Please Check your Parameters"; "No Missing Family Types Found"; }
scopeIf = Custom[CW.ScopeIf+](VARtest=anyTrue, VARtrue=code_block_3.out0, VARfalse=code_block_3.out1)  # package Synthesize toolkit; A (hopefully) more robust implementation of ScopeIf. Tests a single boolean and returns a value accordingly.
anyTrue_2 = Custom[CW.List.AnyTrue](VARseq=eq_2)
code_block_4 = CodeBlock { "One or More Family Parameters are Empty, Please Check your Parameters Values"; "No Missing Family Parameters Found"; }
scopeIf_2 = Custom[CW.ScopeIf+](VARtest=anyTrue_2, VARtrue=code_block_4.out0, VARfalse=code_block_4.out1)
code_block_5 = CodeBlock { null; }
filterByBoolMask_3 = List.FilterByBoolMask(list=filterByBoolMask_2.out, mask=eq_3)
getParameterValueByName_4 = Element.GetParameterValueByName(element=filterByBoolMask_3.out, parameterName=n02_family_type_parameter)
scopeIf_3 = Custom[CW.ScopeIf+](VARtest=n08_force_placement_without_check, VARtrue=code_block_5, VARfalse=getParameterValueByName_4)
boundaries = Custom[CW.Room.Boundaries](VARroom=filterByBoolMask_3.out)  # package Synthesize toolkit; Gets a list of all boundary elements of a given room or area
as_polycurve_bycurves = Custom[AS.[&] PolyCurve.ByCurves](VARcurves=boundaries.VARcurves)  # package Synthesize toolkit; Create polycurves from an unordered list of curves.
turnIntoList = Custom[CW.TurnIntoList](VARunknownItem=as_polycurve_bycurves.VARpolyCurve)  # package Synthesize toolkit; Turns an element (or a nested list) into a flat list
code_block_6 = CodeBlock { false; }
clean = List.Clean(list=turnIntoList, preserveIndices=code_block_6)
getParameterValueByName_5 = Element.GetParameterValueByName(element=filterByBoolMask_3.out, parameterName=n04_offset_parameter)
code_block_7 = CodeBlock { ""; }
eq_4 = _ == code_block_7  # unwired: x
replaceByCondition = Replace(item=getParameterValueByName_5, replaceWith=n07_overriden_offset_value_from, condition=eq_4)
offset = PolyCurve.Offset(polyCurve=clean, signedDistance=replaceByCondition, extendCircular=code_block_6)
code_block_8 = CodeBlock { 0; 1; 0.01; }
range = Range(start=code_block_8.out0, end=code_block_8.out1, step=code_block_8.out2, lacing=Longest)
pointAtParameter = Curve.PointAtParameter(curve=offset@L1, param=range)
byPoints = Polygon.ByPoints()  # unwired: points
map = List.Map(list=pointAtParameter, f_x=byPoints)
all_elements_of_family_type = ElementsOfFamilyType(Family_Type=getParameterValueByName_4)
location = FamilyInstance.Location()  # unwired: familyInstance
map_2 = List.Map(list=all_elements_of_family_type, f_x=location)
containmentTest = Custom[CW.Polygon.ContainmentTest+](VARpolygon=map, VARpoints=map_2)  # package Synthesize toolkit; A less accurate method that should perform faster than the built-in node for large data sets.
code_block_9 = CodeBlock { false; }
replaceNull = Custom[CW.List.ReplaceNull](VARseq=containmentTest, VARreplacement=code_block_9)  # package Synthesize toolkit; Replaces all null values within a given list with a substitute
anyTrue_3 = Custom[CW.List.AnyTrue]()  # unwired: VARseq
map_3 = List.Map(list=replaceNull, f_x=anyTrue_3)
filterByBoolMask_4 = List.FilterByBoolMask(list=scopeIf_3, mask=map_3)
code_block_10 = CodeBlock { false; }
clean_2 = List.Clean(list=filterByBoolMask_4.out, preserveIndices=code_block_10)
byGeometry = BoundingBox.ByGeometry(geom=map@L1)
toCuboid = BoundingBox.ToCuboid(boundingBox=byGeometry)
explode = Geometry.Explode(geometry=toCuboid)
flatten = List.Flatten(list=explode)
perimeterCurves = Surface.PerimeterCurves(surface=flatten)
length = Curve.Length(curve=perimeterCurves)
minimumItem = List.MinimumItem(list=length)
code_block_11 = CodeBlock { false; }
offset_2 = PolyCurve.Offset(polyCurve=clean, signedDistance=minimumItem, extendCircular=code_block_11)
byJoinedCurves = PolyCurve.ByJoinedCurves()  # unwired: curves
map_4 = List.Map(list=offset_2, f_x=byJoinedCurves)
closeWithLine = PolyCurve.CloseWithLine(polyCurve=map_4)
byPatch = Surface.ByPatch(closedCurve=closeWithLine)
toNurbsSurface = Surface.ToNurbsSurface(surface=byPatch)
join = List.Join()  # unwired: list0, list1
boundingBox = Geometry.BoundingBox(geometry=byPatch)
minPoint = BoundingBox.MinPoint(boundingBox=boundingBox)
X = Point.X(point=minPoint)
Y = Point.Y(point=minPoint)
byCoordinates = Point.ByCoordinates(x=X, y=Y)
maxPoint = BoundingBox.MaxPoint(boundingBox=boundingBox)
X_2 = Point.X(point=maxPoint)
byCoordinates_2 = Point.ByCoordinates(x=X_2, y=Y)
byStartPointEndPoint = Line.ByStartPointEndPoint(startPoint=byCoordinates, endPoint=byCoordinates_2)
length_2 = Curve.Length(curve=byStartPointEndPoint)
byCoordinates_3 = Point.ByCoordinates(x=X_2, y=Y)
Y_2 = Point.Y(point=maxPoint)
byCoordinates_4 = Point.ByCoordinates(x=X_2, y=Y_2)
byStartPointEndPoint_2 = Line.ByStartPointEndPoint(startPoint=byCoordinates_3, endPoint=byCoordinates_4)
length_3 = Curve.Length(curve=byStartPointEndPoint_2)
combine = List.Combine(comb=join, list1=length_2, list2=length_3)
getParameterValueByName_6 = Element.GetParameterValueByName(element=filterByBoolMask_3.out, parameterName=n03_spacing_parameter)
div = combine / getParameterValueByName_6
firstItem = List.FirstItem()  # unwired: list
map_5 = List.Map(list=div, f_x=firstItem)
round = Math.Round(number=map_5)
lastItem = List.LastItem()  # unwired: list
map_6 = List.Map(list=div, f_x=lastItem)
round_2 = Math.Round(number=map_6)
code_block_12 = CodeBlock { false; }
code_block_13 = CodeBlock { true; }
byNurbsSurfaceUniform = TSpline.TSplineSurface.ByNurbsSurfaceUniform(nurbsSurface=toNurbsSurface, uSpans=round, vSpans=round_2, uUseArcLen=code_block_12, vUseArcLen=code_block_12, inSmoothMode=code_block_13)
vertices = Topology.Vertices(topology=byNurbsSurfaceUniform)
pointGeometry = Vertex.PointGeometry(vertex=vertices)
code_block_14 = CodeBlock { false; }
clean_3 = List.Clean(list=pointGeometry, preserveIndices=code_block_14)
center = Polygon.Center(polygon=map)
normalAtPoint = Surface.NormalAtPoint(surface=toNurbsSurface, point=pointGeometry)
byOriginNormal = Plane.ByOriginNormal(origin=pointGeometry, normal=normalAtPoint)
firstItem_2 = List.FirstItem(list=byOriginNormal@L2)
normal = Plane.Normal()  # unwired: plane
map_7 = List.Map(list=firstItem_2, f_x=normal)
clean_4 = List.Clean(list=map_7, preserveIndices=code_block_14)
getParameterValueByName_7 = Element.GetParameterValueByName(element=filterByBoolMask_3.out, parameterName=n05_rotation_parameter)
add = getParameterValueByName_7 + n06_rotation_angle_to_add_added
string_from_object = FromObject(obj=add)
trimWhitespace = String.TrimWhitespace()  # unwired: string
map_8 = List.Map(list=string_from_object, f_x=trimWhitespace)
isNull = Object.IsNull()  # unwired: object
replaceByCondition_2 = Replace(item=map_8, replaceWith=add, condition=isNull)
toNumber = String.ToNumber(string=replaceByCondition_2)
rotate = Geometry.Rotate(geometry=clean_3, origin=center, axis=clean_4, degrees=toNumber)
containmentTest_2 = Custom[CW.Polygon.ContainmentTest+](VARpolygon=map, VARpoints=rotate)
filterByBoolMask_5 = List.FilterByBoolMask(list=rotate, mask=containmentTest_2)
filterByBoolMask_6 = List.FilterByBoolMask(list=filterByBoolMask_5.in, mask=map_3)
byPoint = FamilyInstance.ByPoint(familyType=clean_2, point=filterByBoolMask_6.out)
scopeIf_4 = Custom[CW.ScopeIf+](VARtest=n08_force_placement_without_check, VARtrue=getParameterValueByName_4, VARfalse=code_block_5)
clean_5 = List.Clean(list=scopeIf_4, preserveIndices=code_block_10)
byPoint_2 = FamilyInstance.ByPoint(familyType=clean_5, point=filterByBoolMask_5.in)
create = List.Create(item0=byPoint, item1=byPoint_2)
code_block_15 = CodeBlock { false; }
clean_6 = List.Clean(list=create, preserveIndices=code_block_15)
flatten_2 = List.Flatten(list=clean_6)
count = List.Count(list=flatten_2)

# group: Report
n01_family_type_parameters_status = Watch(scopeIf)  # "01.Family Type Parameters Status"; graph output
n02_spacing_parameter_status = Watch(scopeIf_2)  # "02.Spacing Parameter Status"; graph output
n03_number_of_families_placed = Watch(count)  # "03.Number of Families Placed"; graph output

string_from_object_2 = FromObject(obj=getParameterValueByName_5)
generate_selection_filter = Custom[Generate Selection Filter](VARCreateSelectionFilter=n09_create_selection_filter, VARFilterNametoCreate=n10_filter_name_to_create, VAROverwriteExistingFilter=n11_overwrite_existing_filter, VARElements=flatten_2)  # package Synthesize toolkit; Generate Selection FIlter
debug_python = Custom[Debug Python]()  # package Synthesize toolkit; Debug Python
