# Dynamo graph Family.Scatter Randomly (Non-Workplane Families) By Solid or Surfaces.dyn (Dynamo 2.13.1.3887)
# author: karam@aecedx.com
# packages: Synthesize toolkit 12.5.1

# group: Input
n09_create_selection_filter = BoolSelector(true)  # "09.Create Selection Filter ?"; graph input
n10_filter_name_to_create = StringInput("Dynamo Scattered Elements Randomly")  # "10.Filter Name to Create"; graph input
n11_overwrite_existing_filter = BoolSelector(false)  # "11.Overwrite Existing Filter ? (False for Adding Elements)"; graph input
n05_filter_if_surfaces_found_1 = IntegerSlider(2, range=1..4 step 1)  # "05.Filter If Surfaces Found (1 = Vertical Faces | 2 = Horizontal Up Faces | 3 = Horizontal Down Faces | 4 = All Faces)"; graph input
n01_select_scatter_boundaries = DSModelElementsSelection()  # "01.Select Scatter Boundaries (Solids or Surfaces)"; nothing selected; graph input
offset = DoubleInput(0)  # "02.Offset"; graph input
n03_maximum_number_of_elements = DoubleInput(100)  # "03.Maximum Number of Elements"; graph input
n04_spacing_between_elements = DoubleInput(5)  # "04.Spacing Between Elements"; graph input
n07_all_types_false_for_specific = BoolSelector(true)  # "07.All Types ? (False for Specific Types)"; graph input
n06_family_names_separate_by = StringInput("AECedx_Tree*")  # "06.Family Names (Separate By Comma , - or * To Select All Matching)"; graph input
n08_specific_type_names_separate = StringInput("Type 1")  # "08.Specific Type Names (Separate By Comma , )"; graph input

code_block = CodeBlock { 4; 1; 2; 3; null; false; }
eq = n05_filter_if_surfaces_found_1 == code_block.out0
element_geometry_fixer = Custom[Element.Geometry Fixer](VARElement=n01_select_scatter_boundaries)  # package Synthesize toolkit; Element.Geometry Fixer
flatten = List.Flatten(list=element_geometry_fixer)
code_block_2 = CodeBlock { "Surface"; "Solid"; }
byClassName = Custom[SP.Filter.ByClassName](VARobject=flatten, VARclassName=code_block_2.out0)  # package Synthesize toolkit; Filters a list of objects by the object's class name. Note that Dynamo elements belong to different classes than their Revit counterparts. Use the Object.Class node to check an object's class.
byClassName_2 = Custom[SP.Filter.ByClassName](VARobject=byClassName.VARout, VARclassName=code_block_2.out1)
explode = Geometry.Explode(geometry=byClassName_2.VARin)
flatten_2 = List.Flatten(list=explode)
create = List.Create(item0=flatten_2, item1=byClassName.VARin)
code_block_3 = CodeBlock { false; }
clean = List.Clean(list=create, preserveIndices=code_block_3)
flatten_3 = List.Flatten(list=clean)
scopeIf = Custom[CW.ScopeIf+](VARtest=eq, VARtrue=flatten_3, VARfalse=code_block.out4)  # package Synthesize toolkit; A (hopefully) more robust implementation of ScopeIf. Tests a single boolean and returns a value accordingly.
eq_2 = n05_filter_if_surfaces_found_1 == code_block.out1
filterByOrientation = Custom[CW.Surface.FilterByOrientation](VARsurfaces=flatten_3)  # package Synthesize toolkit; Sorts surfaces in three lists based on their orientation (vertical, horizontal up & horizontal down) and also returns three corresponding lists of booleans.
scopeIf_2 = Custom[CW.ScopeIf+](VARtest=eq_2, VARtrue=filterByOrientation.VARvertical, VARfalse=code_block.out4)
eq_3 = n05_filter_if_surfaces_found_1 == code_block.out2
scopeIf_3 = Custom[CW.ScopeIf+](VARtest=eq_3, VARtrue=filterByOrientation.VARhorizontalUp, VARfalse=code_block.out4)
eq_4 = n05_filter_if_surfaces_found_1 == code_block.out3
scopeIf_4 = Custom[CW.ScopeIf+](VARtest=eq_4, VARtrue=filterByOrientation.VARhorizontalDown, VARfalse=code_block.out4)
create_2 = List.Create(item0=scopeIf, item1=scopeIf_2, item2=scopeIf_3, item3=scopeIf_4)
clean_2 = List.Clean(list=create_2, preserveIndices=code_block.out5)
flatten_4 = List.Flatten(list=clean_2)
code_block_4 = CodeBlock { ","; false; }
family_and_type_selector = Custom[Family and Type Selector](VARAllElementsofFamilyNameAlltypes=n07_all_types_false_for_specific, VARFamilyName=n06_family_names_separate_by, VARSpecificTypeNamesSeparatebySymbol=n08_specific_type_names_separate, VARSeparationSymbol=code_block_4.out0, VAROnlyInActiveView=code_block_4.out1)  # package Synthesize toolkit; Family and Type Selector
flatten_5 = List.Flatten(list=family_and_type_selector.VARFamilyTypesList)
python_script = Python(IN[0]=flatten_5)  # IronPython2
# ---------- python_script.python (82 lines) ----------
# Created By Karam Baki : karam@aecedx.com
# Enable Python support and load DesignScript library
# IMPORTANT : ALL DYNAMO DESIGN SCRIPT NODES ARE AS (dg)
import clr
clr.AddReference('ProtoGeometry')
from Autodesk.DesignScript import Geometry as dg

# EXTENSION Enable ToDSType
clr.AddReference('RevitNodes')
import Revit
clr.ImportExtensions(Revit.Elements)

# Enable Revit Elements
from Revit.Elements import *

# EXTENSION Enable Geometry Conversion Methods
clr.ImportExtensions(Revit.GeometryConversion)

# Enable Revit API
clr.AddReference('RevitAPI')
from Autodesk.Revit.DB import *
from Autodesk.Revit.DB.Architecture import *
# Enable DocumentManager and TransactionManager
clr.AddReference('RevitServices')
from RevitServices.Persistence import DocumentManager
from RevitServices.Transactions import TransactionManager

# Enable ICollection List Translate
clr.AddReference("System")
import System.Collections.Generic
from System.Collections.Generic import List

from Autodesk.Revit.DB.Structure import StructuralType

clr.AddReference("RevitAPIUI")
from Autodesk.Revit.UI import TaskDialog

title = "AECedx - Karam"

# Choose The Current Document
doc = DocumentManager.Instance.CurrentDBDocument
uidoc = DocumentManager.Instance.CurrentUIApplication.ActiveUIDocument
uiapp = DocumentManager.Instance.CurrentUIApplication
app = uiapp.Application

famtypes = UnwrapElement(IN[0])

def isworkplane(famtype):
	if not famtype.IsActive: famtype.Activate()
	try:
		test = doc.Create.NewFamilyInstance(XYZ(0,0,0), famtype, StructuralType.NonStructural)
		eachparams = test.GetOrderedParameters()
		workplanebased = False
		for epms in eachparams:
			pname = epms.Definition.Name
			if pname == "Work Plane":
					workplanebased = True
		doc.Delete(test.Id)
	except:
		workplanebased = False
	
	return workplanebased

TransactionManager.Instance.EnsureInTransaction(doc)
workplaneslist = []
for famtype in famtypes:
	if isworkplane(famtype) == True:
		workplaneslist.append(famtype.FamilyName + " (Is Workplane Based)")
TransactionManager.Instance.TransactionTaskDone()

temp_list = []
for i in workplaneslist:
    if i not in temp_list:
        temp_list.append(i)
workplaneslist = temp_list

if len(workplaneslist) > 0:
	workplaneslist.Insert(0,"Convert The Following to Non-Workplane:")
	msg = "\n".join(workplaneslist)
	OUT = TaskDialog.Show(title, msg)
else:
	OUT = famtypes
# ----------------------------------------
scatter_elements = Custom[Scatter Elements](VARSurfaces=flatten_4, VAROffset=offset, VARMaximumNumberofElements=n03_maximum_number_of_elements, VARSpacingBetweenElements=n04_spacing_between_elements, VARFamilyTypeList=python_script)  # package Synthesize toolkit; Scatter Elements
generate_selection_filter = Custom[Generate Selection Filter](VARCreateSelectionFilter=n09_create_selection_filter, VARFilterNametoCreate=n10_filter_name_to_create, VAROverwriteExistingFilter=n11_overwrite_existing_filter, VARElements=scatter_elements)  # package Synthesize toolkit; Generate Selection FIlter
debug_python = Custom[Debug Python]()  # package Synthesize toolkit; Debug Python
