# Dynamo graph Family.Solids Chamfer By Edges Selection.dyn (Dynamo 2.13.1.3887)
# author: karam@aecedx.com
# packages: Synthesize toolkit 12.5.1

debug_python = Custom[Debug Python]()  # package Synthesize toolkit; Debug Python

# group: Input
n01_select_solids = DSModelElementsSelection()  # "01.Select Solids"; nothing selected; graph input
n02_select_edges = SelectEdges()  # "02.Select Edges"; nothing selected; graph input
n03_chamfer_offset = DoubleInput(5)  # "03.Chamfer Offset"; graph input
n05_family_method_one_family = BoolSelector(false)  # "05.Family Method : One Family ?"; graph input
n07_family_method_family_name = StringInput("Dynamo Chamfered Element")  # "07.Family Method : Family Name"; graph input
n08_family_method_start_sequence = DoubleInput(1)  # "08.Family Method : Start Sequence (Naming Suffix)"; graph input
n09_family_method_family_category = Categories("OST_GenericModel")  # "09.Family Method : Family Category"; graph input
n10_family_method_family_template = Filename("..\..\..\..\..\..\..\..\..\..\ProgramData\Autodesk\RVT 2020\Family Templates\English\Metric Generic Model.rft")  # "10.Family Method : Family Template of The Above Category"; graph input
n06_family_method_is_shared = BoolSelector(false)  # "06.Family Method : Is Shared Family ?"; graph input
n04_method_false_imported_object = BoolSelector(true)  # "04.Method : False = Imported Object | True = Mass Family"; graph input

element_geometry_fast = Custom[Element.Geometry Fast](VARElements=n01_select_solids)  # package Synthesize toolkit; Element.Geometry Fast
edges = Topology.Edges(topology=element_geometry_fast)
flatten = List.Flatten(list=edges@L2)
code_block = CodeBlock { 0.5; }
pointAtParameter = Curve.PointAtParameter(curve=n02_select_edges, param=code_block)
count = List.Count(list=pointAtParameter)
ofRepeatedItem = List.OfRepeatedItem(item=flatten, amount=count)
curveGeometry = Edge.CurveGeometry(edge=flatten)
pointAtParameter_2 = Curve.PointAtParameter(curve=curveGeometry, param=code_block)
distanceTo = Geometry.DistanceTo(geometry=pointAtParameter_2, other=pointAtParameter@L1)
code_block_2 = CodeBlock { 0; }
eq = distanceTo == code_block_2
filterByBoolMask = List.FilterByBoolMask(list=ofRepeatedItem, mask=eq)
transpose = List.Transpose(lists=filterByBoolMask.in)
code_block_3 = CodeBlock { false; }
clean = List.Clean(list=transpose, preserveIndices=code_block_3)
flatten_2 = List.Flatten(list=clean@L3)
chamfer = Solid.Chamfer(solid=element_geometry_fast, edges=flatten_2, offset=n03_chamfer_offset)
flatten_3 = List.Flatten(list=chamfer)
code_block_4 = CodeBlock { true; }
ne = code_block_4 != n04_method_false_imported_object
k_family_insert = Custom[K-Family Insert](VARGeometryorSAT=flatten_3, VAROneFamily=n05_family_method_one_family, VARFamilyName=n07_family_method_family_name, VARFamilyNumber=n08_family_method_start_sequence, VARFamilyCategory=n09_family_method_family_category, VARFamilyTemplatePath=n10_family_method_family_template, VARIsShared=n06_family_method_is_shared, VARImportInstanceInstead=ne)  # package Synthesize toolkit; K-Family Insert
