# Dynamo graph Family.Types K-Attractor By Isolated Elements.dyn (Dynamo 2.13.1.3887)
# author: karam@aecedx.com
# packages: Synthesize toolkit 12.5.1

# group: Input
n03_all_types_false_for_specific = BoolSelector(true)  # "03.All Types ? (False for Specific Types)"; graph input
n02_family_names_separate_by = StringInput("System Panel")  # "02.Family Names (Separate By Comma , - or * To Select All Matching)"; graph input
n04_specific_type_names_separate = StringInput("Glazed, Solid")  # "04.Specific Type Names (Separate By Comma , )"; graph input
n01_select_attractors = DSModelElementsSelection()  # "01.Select Attractors"; nothing selected; graph input
n07_reverse_types = BoolSelector(false)  # "07.Reverse Types ?"; graph input
n05_balanced_rhythm_seed = BoolSelector(true)  # "05.Balanced Rhythm (Seed) ?"; graph input
n06_custom_seed_value = DoubleInput(0)  # "06.Custom Seed Value"; graph input
n08_proceed = BoolSelector(false)  # "08.Proceed ?"; graph input

code_block = CodeBlock { ","; false; }
family_and_type_selector = Custom[Family and Type Selector](VARAllElementsofFamilyNameAlltypes=n03_all_types_false_for_specific, VARFamilyName=n02_family_names_separate_by, VARSpecificTypeNamesSeparatebySymbol=n04_specific_type_names_separate, VARSeparationSymbol=code_block.out0, VAROnlyInActiveView=code_block.out1)  # package Synthesize toolkit; Family and Type Selector
python_all_elements_in_active = Custom[Python All Elements In Active View]()  # package Synthesize toolkit; Python All Elements In Active View
k_attractor_for_family_types = Custom[K-Attractor For Family Types](VARFamilyTypesList=family_and_type_selector.VARFamilyTypesList, VARAttractors=n01_select_attractors, VARFamilyName=family_and_type_selector.VARFamilyNames, VARReverseTypes=n07_reverse_types, VARAllTypesFalseforSpecificTypes=n03_all_types_false_for_specific, VARBalancedRhythmSeed=n05_balanced_rhythm_seed, VARCustomSeedValue=n06_custom_seed_value, VARProceed=n08_proceed, VARAllElementsInActiveView=python_all_elements_in_active)  # package Synthesize toolkit; K-Attractor For Family Types

# group: Result
n01_balanced_seed_value = Watch(k_attractor_for_family_types.VARBalancedSeedValue)  # "01.Balanced Seed Value"; graph output
n02_number_of_total_elements = Watch(k_attractor_for_family_types.VARNumberofTotalElements)  # "02.Number of Total Elements"; graph output
n03_types_order_to_use = Watch(k_attractor_for_family_types.VARTypesOrdertoUse)  # "03.Types Order to Use"; graph output
n04_elements_to_select = Watch(k_attractor_for_family_types.VARElementstoselect)  # "04.Elements to select"; graph output

debug_python = Custom[Debug Python]()  # package Synthesize toolkit; Debug Python
