# Dynamo graph Filter.Selection K-Filter Create By Element Type.dyn (Dynamo 2.13.1.3887)
# author: karam@aecedx.com
# packages: Synthesize toolkit 12.5.1

# group: Input
n04_select_in_revit = BoolSelector(false)  # "04.Select in Revit ?"; graph input
n07_filter_by_parameters_is_type = BoolSelector(false)  # "07.Filter By Parameters : Is Type Parameter ?"; graph input
n06_filter_by_parameters = BoolSelector(false)  # "06.Filter By Parameters ?"; graph input
n12_filter_by_parameters_rounding = DoubleInput(0.01)  # "12.Filter By Parameters : Rounding - If Numbers Found"; graph input
n08_filter_by_parameters_filter = BoolSelector(false)  # "08.Filter By Parameters : Filter Mode : False = OR | True = AND"; graph input
n09_filter_by_parameters = StringInput("Area")  # "09.Filter By Parameters : Parameter(s) Name To Filter With - Separate By Symbol"; graph input
n11_separation_symbol = StringInput(",")  # "11.Separation Symbol"; graph input
n10_filter_by_parameters = StringInput(">50")  # "10.Filter By Parameters : Parameter(s) Value To Filter With - Separate By Symbol"; graph input
n01_element_type_familyinstance = ElementTypes("FamilyInstance")  # "01.Element Type (FamilyInstance for All Loadable Families)"; graph input
n13_fetch_groups_elements_might = BoolSelector(false)  # "13.Fetch Groups Elements (Might Help For Strange Behaviours Like Stairs)"; graph input
n05_proceed = BoolSelector(false)  # "05.Proceed ?"; graph input
n02_filter_name_to_create = StringInput("Dynamo Element Type Filter")  # "02.Filter Name to Create"; graph input
n03_overwrite_existing_filter = BoolSelector(false)  # "03.Overwrite Existing Filter ? (False For Adding Elements)"; graph input

split = String.Split(string=n09_filter_by_parameters, separator0=n11_separation_symbol)
split_2 = String.Split(string=n10_filter_by_parameters, separator0=n11_separation_symbol)
all_elements_of_type = ElementsOfType(element_type=n01_element_type_familyinstance)
recurring_group_elements_fetch = Custom[Recurring Group Elements Fetch](VARElements=all_elements_of_type, VARFetch=n13_fetch_groups_elements_might)  # package Synthesize toolkit; Recurring Group Elements Fetch
advanced_elements_filter = Custom[Advanced Elements Filter](VARIsTypeParameter=n07_filter_by_parameters_is_type, VARFilterByOtherParameters=n06_filter_by_parameters, VARRoundingIfNumbersFound=n12_filter_by_parameters_rounding, VARFilterModeFalseORTrueAND=n08_filter_by_parameters_filter, VARParametersList=split, VARParameterValues=split_2, VARElements=recurring_group_elements_fetch)  # package Synthesize toolkit; Advanced Elements Filter
code_block = CodeBlock { null; }
scopeIf = Custom[CW.ScopeIf+](VARtest=n04_select_in_revit, VARtrue=advanced_elements_filter.VARElements, VARfalse=code_block)  # package Synthesize toolkit; A (hopefully) more robust implementation of ScopeIf. Tests a single boolean and returns a value accordingly.
clean = List.Clean(list=scopeIf)
hot_select_in_revit = Custom[HOT.Select in Revit](VARElement=clean)  # package Synthesize toolkit; Select Elements in Revit
count = List.Count(list=advanced_elements_filter.VARElements)
generate_selection_filter = Custom[Generate Selection Filter](VARCreateSelectionFilter=n05_proceed, VARFilterNametoCreate=n02_filter_name_to_create, VAROverwriteExistingFilter=n03_overwrite_existing_filter, VARElements=advanced_elements_filter.VARElements)  # package Synthesize toolkit; Generate Selection FIlter
count_2 = List.Count(list=generate_selection_filter.VARElements)

# group: Report
n01_number_of_elements_selected = Watch(count)  # "01.Number of Elements Selected"; graph output
n02_total_number_of_elements = Watch(count_2)  # "02.Total Number of Elements Inside Filter"; graph output

debug_python_no_message = Custom[Debug Python No Message]()  # package Synthesize toolkit; Debug Python
