# Dynamo graph Filter.Selection K-Filter Create By Family and Type.dyn (Dynamo 2.13.1.3887)
# author: karam@aecedx.com
# packages: Synthesize toolkit 12.5.1

# group: Input
n07_select_in_revit = BoolSelector(false)  # "07.Select in Revit ?"; graph input
n10_filter_by_parameters_is_type = BoolSelector(false)  # "10.Filter By Parameters : Is Type Parameter ?"; graph input
n09_filter_by_parameters = BoolSelector(false)  # "09.Filter By Parameters ?"; graph input
n15_filter_by_parameters_rounding = DoubleInput(0.01)  # "15.Filter By Parameters : Rounding - If Numbers Found"; graph input
n11_filter_by_parameters_filter = BoolSelector(false)  # "11.Filter By Parameters : Filter Mode : False = OR | True = AND"; graph input
n12_filter_by_parameters = StringInput("Area")  # "12.Filter By Parameters : Parameter(s) Name To Filter With - Separate By Symbol"; graph input
n14_separation_symbol = StringInput(",")  # "14.Separation Symbol"; graph input
n13_filter_by_parameters = StringInput(">50")  # "13.Filter By Parameters : Parameter(s) Value To Filter With - Separate By Symbol"; graph input
n01_all_elements_of_family_name = BoolSelector(true)  # "01.All Elements of Family Name (All types) ?"; graph input
n02_family_names_separate_by = StringInput("Family")  # "02.Family Names (Separate By Comma , - or * To Select All Matching)"; graph input
n03_specific_type_name_separate = StringInput("Type")  # "03.Specific Type Name (Separate by Comma , )"; graph input
code_block = CodeBlock { ","; }
n04_elements_in_active_view_only = BoolSelector(false)  # "04.Elements In Active View Only ?"; graph input
n16_fetch_groups_elements_might = BoolSelector(false)  # "16.Fetch Groups Elements (Might Help For Strange Behaviours Like Stairs)"; graph input
n08_proceed = BoolSelector(false)  # "08.Proceed ?"; graph input
n05_filter_name_to_create = StringInput("Dynamo Family and Type Filter")  # "05.Filter Name to Create"; graph input
n06_overwrite_existing_filter = BoolSelector(false)  # "06.Overwrite Existing Filter ? (False For Adding Elements)"; graph input

split = String.Split(string=n12_filter_by_parameters, separator0=n14_separation_symbol)
split_2 = String.Split(string=n13_filter_by_parameters, separator0=n14_separation_symbol)
family_and_type_selector = Custom[Family and Type Selector](VARAllElementsofFamilyNameAlltypes=n01_all_elements_of_family_name, VARFamilyName=n02_family_names_separate_by, VARSpecificTypeNamesSeparatebySymbol=n03_specific_type_name_separate, VARSeparationSymbol=code_block, VAROnlyInActiveView=n04_elements_in_active_view_only)  # package Synthesize toolkit; Family and Type Selector
recurring_group_elements_fetch = Custom[Recurring Group Elements Fetch](VARElements=family_and_type_selector.VARElements, VARFetch=n16_fetch_groups_elements_might)  # package Synthesize toolkit; Recurring Group Elements Fetch
advanced_elements_filter = Custom[Advanced Elements Filter](VARIsTypeParameter=n10_filter_by_parameters_is_type, VARFilterByOtherParameters=n09_filter_by_parameters, VARRoundingIfNumbersFound=n15_filter_by_parameters_rounding, VARFilterModeFalseORTrueAND=n11_filter_by_parameters_filter, VARParametersList=split, VARParameterValues=split_2, VARElements=recurring_group_elements_fetch)  # package Synthesize toolkit; Advanced Elements Filter
code_block_2 = CodeBlock { null; }
scopeIf = Custom[CW.ScopeIf+](VARtest=n07_select_in_revit, VARtrue=advanced_elements_filter.VARElements, VARfalse=code_block_2)  # package Synthesize toolkit; A (hopefully) more robust implementation of ScopeIf. Tests a single boolean and returns a value accordingly.
clean = List.Clean(list=scopeIf)
hot_select_in_revit = Custom[HOT.Select in Revit](VARElement=clean)  # package Synthesize toolkit; Select Elements in Revit
count = List.Count(list=advanced_elements_filter.VARElements)
generate_selection_filter = Custom[Generate Selection Filter](VARCreateSelectionFilter=n08_proceed, VARFilterNametoCreate=n05_filter_name_to_create, VAROverwriteExistingFilter=n06_overwrite_existing_filter, VARElements=advanced_elements_filter.VARElements)  # package Synthesize toolkit; Generate Selection FIlter
count_2 = List.Count(list=generate_selection_filter.VARElements)

# group: Report
n01_number_of_elements_selected = Watch(count)  # "01.Number of Elements Selected"; graph output
n02_total_number_of_elements = Watch(count_2)  # "02.Total Number of Elements Inside Filter"; graph output

debug_python_no_message = Custom[Debug Python No Message]()  # package Synthesize toolkit; Debug Python
