# Dynamo graph Filter.Selection K-Filter Create By Intersecting Solids or Surfaces.dyn (Dynamo 2.13.1.3887)
# author: karam@aecedx.com
# packages: Synthesize toolkit 12.5.1

# group: Input
n04_select_in_revit = BoolSelector(false)  # "04.Select in Revit ?"; graph input
n07_filter_by_parameters_is_type = BoolSelector(false)  # "07.Filter By Parameters : Is Type Parameter ?"; graph input
n06_filter_by_parameters = BoolSelector(false)  # "06.Filter By Parameters ?"; graph input
n12_filter_by_parameters_rounding = DoubleInput(0.01)  # "12.Filter By Parameters : Rounding - If Numbers Found"; graph input
n08_filter_by_parameters_filter = BoolSelector(false)  # "08.Filter By Parameters : Filter Mode : False = OR | True = AND"; graph input
n09_filter_by_parameters = StringInput("Area")  # "09.Filter By Parameters : Parameter(s) Name To Filter With - Separate By Symbol"; graph input
n11_separation_symbol = StringInput(",")  # "11.Separation Symbol"; graph input
n10_filter_by_parameters = StringInput(">50")  # "10.Filter By Parameters : Parameter(s) Value To Filter With - Separate By Symbol"; graph input
n01_select_solids_surfaces = DSModelElementsSelection()  # "01.Select Solids/Surfaces"; nothing selected; graph input
n13_fetch_groups_elements_might = BoolSelector(false)  # "13.Fetch Groups Elements (Might Help For Strange Behaviours Like Stairs)"; graph input
n05_proceed = BoolSelector(false)  # "05.Proceed ?"; graph input
n02_filter_name_to_create = StringInput("Dynamo Intersecting Solids or Surfaces Filter")  # "02.Filter Name to Create"; graph input
n03_overwrite_existing_filter = BoolSelector(false)  # "03.Overwrite Existing Filter ? (False For Adding Elements)"; graph input

split = String.Split(string=n09_filter_by_parameters, separator0=n11_separation_symbol)
split_2 = String.Split(string=n10_filter_by_parameters, separator0=n11_separation_symbol)
python_all_elements_in_active = Custom[Python All Elements In Active View]()  # package Synthesize toolkit; Python All Elements In Active View
geometry = Element.Geometry(element=n01_select_solids_surfaces)
code_block = CodeBlock { "Surface"; "Solid"; }
byClassName = Custom[SP.Filter.ByClassName](VARobject=geometry, VARclassName=code_block.out0)  # package Synthesize toolkit; Filters a list of objects by the object's class name. Note that Dynamo elements belong to different classes than their Revit counterparts. Use the Object.Class node to check an object's class.
byClassName_2 = Custom[SP.Filter.ByClassName](VARobject=byClassName.VARout, VARclassName=code_block.out1)
create = List.Create(item0=byClassName.VARin, item1=byClassName_2.VARin)
code_block_2 = CodeBlock { false; }
clean = List.Clean(list=create, preserveIndices=code_block_2)
flatten = List.Flatten(list=clean)
count = List.Count(list=flatten)
ofRepeatedItem = List.OfRepeatedItem(item=python_all_elements_in_active, amount=count)
code_block_3 = CodeBlock { true; }
location_of_any_element = Custom[Location Of Any Element](VARElements=python_all_elements_in_active, VARGetAllPointsOfAdaptiveComponents=code_block_3)  # package Synthesize toolkit; Location Of Any Element
code_block_4 = CodeBlock { 2; }
normalizeDepth = List.NormalizeDepth(list=location_of_any_element.VARLocations, rank=code_block_4)
doesIntersect = Geometry.DoesIntersect(geometry=flatten@L1, other=normalizeDepth)
anyTrue = Custom[CW.List.AnyTrue](VARseq=doesIntersect)  # package Synthesize toolkit; Returns true if any item in a list of booleans is true.
filterByBoolMask = List.FilterByBoolMask(list=ofRepeatedItem, mask=anyTrue)
flatten_2 = List.Flatten(list=filterByBoolMask.in)
recurring_group_elements_fetch = Custom[Recurring Group Elements Fetch](VARElements=flatten_2, VARFetch=n13_fetch_groups_elements_might)  # package Synthesize toolkit; Recurring Group Elements Fetch
advanced_elements_filter = Custom[Advanced Elements Filter](VARIsTypeParameter=n07_filter_by_parameters_is_type, VARFilterByOtherParameters=n06_filter_by_parameters, VARRoundingIfNumbersFound=n12_filter_by_parameters_rounding, VARFilterModeFalseORTrueAND=n08_filter_by_parameters_filter, VARParametersList=split, VARParameterValues=split_2, VARElements=recurring_group_elements_fetch)  # package Synthesize toolkit; Advanced Elements Filter
code_block_5 = CodeBlock { null; }
scopeIf = Custom[CW.ScopeIf+](VARtest=n04_select_in_revit, VARtrue=advanced_elements_filter.VARElements, VARfalse=code_block_5)  # package Synthesize toolkit; A (hopefully) more robust implementation of ScopeIf. Tests a single boolean and returns a value accordingly.
clean_2 = List.Clean(list=scopeIf)
hot_select_in_revit = Custom[HOT.Select in Revit](VARElement=clean_2)  # package Synthesize toolkit; Select Elements in Revit
count_2 = List.Count(list=advanced_elements_filter.VARElements)
generate_selection_filter = Custom[Generate Selection Filter](VARCreateSelectionFilter=n05_proceed, VARFilterNametoCreate=n02_filter_name_to_create, VAROverwriteExistingFilter=n03_overwrite_existing_filter, VARElements=advanced_elements_filter.VARElements)  # package Synthesize toolkit; Generate Selection FIlter
count_3 = List.Count(list=generate_selection_filter.VARElements)

# group: Report
n01_number_of_elements_selected = Watch(count_2)  # "01.Number of Elements Selected"; graph output
n02_total_number_of_elements = Watch(count_3)  # "02.Total Number of Elements Inside Filter"; graph output

debug_python_no_message = Custom[Debug Python No Message]()  # package Synthesize toolkit; Debug Python
