# Dynamo graph Filter.Selection K-Filter Create By Material Search.dyn (Dynamo 2.13.1.3887)
# author: karam@aecedx.com
# packages: Synthesize toolkit 12.5.1

# group: Input
n05_select_in_revit = BoolSelector(false)  # "05.Select in Revit ?"; graph input
n08_filter_by_parameters_is_type = BoolSelector(false)  # "08.Filter By Parameters : Is Type Parameter ?"; graph input
n07_filter_by_parameters = BoolSelector(false)  # "07.Filter By Parameters ?"; graph input
n13_filter_by_parameters_rounding = DoubleInput(0.01)  # "13.Filter By Parameters : Rounding - If Numbers Found"; graph input
n09_filter_by_parameters_filter = BoolSelector(false)  # "09.Filter By Parameters : Filter Mode : False = OR | True = AND"; graph input
n10_filter_by_parameters = StringInput("Area")  # "10.Filter By Parameters : Parameter(s) Name To Filter With - Separate By Symbol"; graph input
n12_separation_symbol = StringInput(",")  # "12.Separation Symbol"; graph input
n11_filter_by_parameters = StringInput(">50")  # "11.Filter By Parameters : Parameter(s) Value To Filter With - Separate By Symbol"; graph input
n01_materials_to_search_separate = StringInput("Cherry, Aluminum")  # "01.Materials to Search (Separate by Symbol)"; graph input
n02_separation_symbol = StringInput(",")  # "02.Separation Symbol"; graph input
n06_proceed = BoolSelector(false)  # "06.Proceed ?"; graph input
n03_filter_name_to_create = StringInput("Dynamo Material Search Filter")  # "03.Filter Name to Create"; graph input
n04_overwrite_existing_filter = BoolSelector(false)  # "04.Overwrite Existing Filter ? (False For Adding Elements)"; graph input

split = String.Split(string=n10_filter_by_parameters, separator0=n12_separation_symbol)
split_2 = String.Split(string=n11_filter_by_parameters, separator0=n12_separation_symbol)
python_all_elements_in_active = Custom[Python All Elements In Active View]()  # package Synthesize toolkit; Python All Elements In Active View
getMaterials = Element.GetMaterials(element=python_all_elements_in_active)
isEmpty = List.IsEmpty(list=getMaterials@L2)
filterByBoolMask = List.FilterByBoolMask(list=python_all_elements_in_active, mask=isEmpty)
getMaterials_2 = Element.GetMaterials(element=filterByBoolMask.out)
name = Material.Name(material=getMaterials_2)
split_3 = String.Split(string=n01_materials_to_search_separate, separator0=n02_separation_symbol)
trimWhitespace = String.TrimWhitespace(string=split_3)
eq = name == trimWhitespace@L1
anyTrue = Custom[CW.List.AnyTrue](VARseq=eq)  # package Synthesize toolkit; Returns true if any item in a list of booleans is true.
count = List.Count(list=anyTrue)
ofRepeatedItem = List.OfRepeatedItem(item=filterByBoolMask.out, amount=count)
filterByBoolMask_2 = List.FilterByBoolMask(list=ofRepeatedItem, mask=anyTrue)
flatten = List.Flatten(list=filterByBoolMask_2.in)
uniqueItems = List.UniqueItems(list=flatten)
advanced_elements_filter = Custom[Advanced Elements Filter](VARIsTypeParameter=n08_filter_by_parameters_is_type, VARFilterByOtherParameters=n07_filter_by_parameters, VARRoundingIfNumbersFound=n13_filter_by_parameters_rounding, VARFilterModeFalseORTrueAND=n09_filter_by_parameters_filter, VARParametersList=split, VARParameterValues=split_2, VARElements=uniqueItems)  # package Synthesize toolkit; Advanced Elements Filter
code_block = CodeBlock { null; }
scopeIf = Custom[CW.ScopeIf+](VARtest=n05_select_in_revit, VARtrue=advanced_elements_filter.VARElements, VARfalse=code_block)  # package Synthesize toolkit; A (hopefully) more robust implementation of ScopeIf. Tests a single boolean and returns a value accordingly.
clean = List.Clean(list=scopeIf)
hot_select_in_revit = Custom[HOT.Select in Revit](VARElement=clean)  # package Synthesize toolkit; Select Elements in Revit
count_2 = List.Count(list=advanced_elements_filter.VARElements)
generate_selection_filter = Custom[Generate Selection Filter](VARCreateSelectionFilter=n06_proceed, VARFilterNametoCreate=n03_filter_name_to_create, VAROverwriteExistingFilter=n04_overwrite_existing_filter, VARElements=advanced_elements_filter.VARElements)  # package Synthesize toolkit; Generate Selection FIlter
count_3 = List.Count(list=generate_selection_filter.VARElements)

# group: Report
n01_number_of_elements_selected = Watch(count_2)  # "01.Number of Elements Selected"; graph output
n02_total_number_of_elements = Watch(count_3)  # "02.Total Number of Elements Inside Filter"; graph output

debug_python_no_message = Custom[Debug Python No Message]()  # package Synthesize toolkit; Debug Python
