# Dynamo graph Filter.Selection K-Filter Delete All Empty.dyn (Dynamo 2.13.1.3887)
# author: karam@aecedx.com
# packages: Synthesize toolkit 12.5.1

n01_proceed = BoolSelector(false)  # "01.Proceed ?"; graph input
hot_get_all_filter = Custom[HOT.Get All Filter]()  # package Synthesize toolkit; Get all Filter
code_block = CodeBlock { "SelectionFilterElement"; }
string_from_object = FromObject(obj=hot_get_all_filter.VARElement)
eq = code_block == string_from_object
filterByBoolMask = List.FilterByBoolMask(list=hot_get_all_filter.VARElement, mask=eq)
python_script = Python(IN[0]=filterByBoolMask.in)  # IronPython2
# ---------- python_script.python (49 lines) ----------
# Created By Karam Baki : karam@aecedx.com
# Enable Python support and load DesignScript library
# IMPORTANT : ALL DYNAMO DESIGN SCRIPT NODES ARE AS (dg)
import clr
clr.AddReference('ProtoGeometry')
from Autodesk.DesignScript import Geometry as dg

# EXTENSION Enable ToDSType
clr.AddReference('RevitNodes')
import Revit
clr.ImportExtensions(Revit.Elements)

# Enable Revit Elements
from Revit.Elements import *

# EXTENSION Enable Geometry Conversion Methods
clr.ImportExtensions(Revit.GeometryConversion)

# Enable Revit API
clr.AddReference('RevitAPI')
from Autodesk.Revit.DB import *

# Enable DocumentManager and TransactionManager
clr.AddReference('RevitServices')
from RevitServices.Persistence import DocumentManager
from RevitServices.Transactions import TransactionManager

# Enable ICollection List Translate
clr.AddReference("System")
import System.Collections.Generic
from System.Collections.Generic import List

dataEnteringNode = IN
# Use UnwrapElement(IN[0]) When Translating From Dynamo to Revit
filters=UnwrapElement(IN[0])

# Choose The Current Document
doc = DocumentManager.Instance.CurrentDBDocument
uidoc = DocumentManager.Instance.CurrentUIApplication.ActiveUIDocument
uiapp = DocumentManager.Instance.CurrentUIApplication
app = uiapp.Application

# Create Empty List
result = []

for each in filters:
	result.append(each.IsEmpty())
	
OUT = result
# ----------------------------------------
filterByBoolMask_2 = List.FilterByBoolMask(list=filterByBoolMask.in, mask=python_script)
flatten = List.Flatten(list=filterByBoolMask_2.in)
code_block_2 = CodeBlock { null; false; }
scopeIf = Custom[CW.ScopeIf+](VARtest=n01_proceed, VARtrue=flatten, VARfalse=code_block_2.out0)  # package Synthesize toolkit; A (hopefully) more robust implementation of ScopeIf. Tests a single boolean and returns a value accordingly.
clean = List.Clean(list=scopeIf, preserveIndices=code_block_2.out1)
eraser = Custom[ST.Tool.Eraser](VARList=clean)  # package Synthesize toolkit; Try to delete any element from project
filterByBoolMask_3 = List.FilterByBoolMask(list=hot_get_all_filter.VARName, mask=eq)
filterByBoolMask_4 = List.FilterByBoolMask(list=filterByBoolMask_3.in, mask=python_script)
flatten_2 = List.Flatten(list=filterByBoolMask_4.in)
isEmpty = List.IsEmpty(list=flatten_2)
code_block_3 = CodeBlock { "Nothing to Delete"; }
scopeIf_2 = Custom[CW.ScopeIf+](VARtest=isEmpty, VARtrue=code_block_3, VARfalse=flatten_2)
flatten_3 = List.Flatten(list=scopeIf_2)
n01_filters_to_delete = Watch(flatten_3)  # "01.Filters to Delete"; graph output
debug_python_no_message = Custom[Debug Python No Message]()  # package Synthesize toolkit; Debug Python
