# Dynamo graph Filter.Selection K-Filter Delete By Name.dyn (Dynamo 2.13.1.3887)
# author: karam@aecedx.com

# group: Input
n01_include_ruled_filters = BoolSelector(true)  # "01.Include Ruled Filters ?"; graph input
n02_filters_to_delete_seperate_by = StringInput("")  # "02.Filters to Delete (Seperate by Comma , )"; graph input
n03_proceed = BoolSelector(false)  # "03.Proceed ?"; graph input

python_script = Python(IN[0]=n01_include_ruled_filters, IN[1]=n02_filters_to_delete_seperate_by, IN[2]=n03_proceed)  # IronPython2
# ---------- python_script.python (101 lines) ----------
# Enable Python support and load DesignScript library
# IMPORTANT : ALL DYNAMO DESIGN SCRIPT NODES ARE AS (dg)
import clr
clr.AddReference('ProtoGeometry')
from Autodesk.DesignScript import Geometry as dg

# EXTENSION Enable ToDSType
clr.AddReference('RevitNodes')
import Revit
clr.ImportExtensions(Revit.Elements)

# Enable Revit Elements
from Revit.Elements import *

# EXTENSION Enable Geometry Conversion Methods
clr.ImportExtensions(Revit.GeometryConversion)

# Enable Revit API
clr.AddReference('RevitAPI')
from Autodesk.Revit.DB import *

# Enable DocumentManager and TransactionManager
clr.AddReference('RevitServices')
from RevitServices.Persistence import DocumentManager
from RevitServices.Transactions import TransactionManager

# Enable ICollection List Translate
clr.AddReference("System")
import System.Collections.Generic
from System.Collections.Generic import List

def tolist(obj1):
	if hasattr(obj1,'__iter__'): return obj1
	else: return [obj1]

def flatten(x):
    result = []
    for el in x:
        if hasattr(el, "__iter__") and not isinstance(el, basestring):
            result.extend(flatten(el))
        else:
            result.append(el)
    return result

dataEnteringNode = IN
# Use UnwrapElement(IN[0]) When Translating From Dynamo to Revit

includerule=IN[0]
names=flatten(tolist(IN[1]))
proceed=IN[2]

# Choose The Current Document
doc = DocumentManager.Instance.CurrentDBDocument
uidoc = DocumentManager.Instance.CurrentUIApplication.ActiveUIDocument
uiapp = DocumentManager.Instance.CurrentUIApplication
app = uiapp.Application

filters= FilteredElementCollector(doc).OfClass(FilterElement).ToElements()

existednames = []
for f in filters:
	existednames.append(f.Name)

TransactionManager.Instance.EnsureInTransaction(doc)
todelete = []
for f in filters:
	if includerule == False and f.ToString() == "Autodesk.Revit.DB.ParameterFilterElement":
		continue
	for name in names:
		if name == "*":
			todelete.append(f)
		elif "*" in name:
			if name in f.Name.lower():
				todelete.append(f)
		else:
			if f.Name.lower() == name.lower():
				todelete.append(f)
namestodelete = []
for delete in todelete:
	namestodelete.append(delete.Name)
if proceed:
	for delete in todelete:
		try:
			doc.Delete(delete.Id)
		except:
			pass
TransactionManager.Instance.TransactionTaskDone()

if proceed:
	filters= FilteredElementCollector(doc).OfClass(FilterElement).ToElements()
	existednames = []
	for f in filters:
		existednames.append(f.Name)

if len(namestodelete) == 0:
	namestodelete = "Nothing to Delete"
	numnamestodel = 0
else:
	numnamestodel = len(namestodelete)

OUT = existednames,len(existednames),namestodelete,numnamestodel
# ----------------------------------------
code_block = CodeBlock(a=python_script) { a[0]; a[1]; a[2]; a[3]; }

# group: Report
n01_existed_filters = Watch(code_block.out0)  # "01.Existed Filters"; graph output
n02_number_of_filters_existed = Watch(code_block.out1)  # "02.Number of Filters Existed"; graph output
n03_filters_to_delete = Watch(code_block.out2)  # "03.Filters to Delete"; graph output
n04_number_of_filters_to_delete = Watch(code_block.out3)  # "04.Number of Filters to Delete"; graph output
