# Dynamo graph Floors.Create By Faces Selection.dyn (Dynamo 2.13.1.3887)
# author: karam@aecedx.com
# packages: Synthesize toolkit 12.6.7

# group: Input
n01_select_surfaces = SelectFaces()  # "01.Select Surfaces"; nothing selected; graph input
n10_method_1_horizontal_up_faces = IntegerSlider(2, range=1..3 step 1)  # "10.Method (1 = Horizontal Up Faces | 2 = Horizontal Down Faces | 3 = All Faces)"; graph input
n02_join_surfaces = BoolSelector(true)  # "02.Join Surfaces ?"; graph input
n04_floor_types = FloorTypes()  # "04.Floor Types"; nothing selected; graph input
n05_use_all_levels_ignores_levels = BoolSelector(true)  # "05.Use All Levels (Ignores Levels Selection Filter)"; graph input
fix_factor_depends_of_project = DoubleInput(1000)  # "Fix Factor (Depends of Project Units, 1 For meters for example, and 100 for Centimeters)"
n06_levels_selection_filter_to = StringInput("Levels Filter Name")  # "06.Levels Selection Filter to Read"; graph input
offset = DoubleInput(0)  # "03.Offset"; graph input
n07_create_selection_filter = BoolSelector(true)  # "07.Create Selection Filter ?"; graph input
n08_filter_name_to_create = StringInput("Dynamo Floors By Surfaces of Elements")  # "08.Filter Name to Create"; graph input
n09_overwrite_existing_filter = BoolSelector(false)  # "09.Overwrite Existing Filter ? (False for Adding Elements)"; graph input

flatten = List.Flatten(list=n01_select_surfaces)
code_block = CodeBlock { "Surface"; }
byClassName = Custom[SP.Filter.ByClassName](VARobject=flatten, VARclassName=code_block)  # package Synthesize toolkit; Filters a list of objects by the object's class name. Note that Dynamo elements belong to different classes than their Revit counterparts. Use the Object.Class node to check an object's class.
python_script = Python(IN[0]=n10_method_1_horizontal_up_faces)  # IronPython2
# ---------- python_script.python (13 lines) ----------
import clr
clr.AddReference('ProtoGeometry')
from Autodesk.DesignScript.Geometry import *
#The inputs to this node will be stored as a list in the IN variables.
dataEnteringNode = IN

method = IN[0]
if method == 1:
	OUT = 2
elif method == 2:
	OUT = 3
else:
	OUT = 23
# ----------------------------------------
surface_orientation_filter = Custom[Surface Orientation Filter](VARSurfaces=byClassName.VARin, VAROrienataion=python_script)  # package Synthesize toolkit; Face Filter
flatten_2 = List.Flatten(list=surface_orientation_filter.VARSurfaces)
code_block_2 = CodeBlock { false; }
join_adjacent_surfaces = Custom[Join Adjacent Surfaces](VARSurfaces=flatten_2, VARJoinOrNot=n02_join_surfaces, VARNormalsCheck=code_block_2)  # package Synthesize toolkit; Join Adjacent Surfaces
perimeterCurves = Surface.PerimeterCurves(surface=join_adjacent_surfaces)
as_polycurve_bycurves = Custom[AS.[&] PolyCurve.ByCurves](VARcurves=perimeterCurves@L2)  # package Synthesize toolkit; Create polycurves from an unordered list of curves.
flatten_3 = List.Flatten(list=as_polycurve_bycurves.VARpolyCurve)
create_floors_by_boundary_lines = Custom[Create Floors By Boundary Lines (Smart)](VARFloorsBoundariesPolycurves=flatten_3, VARFloorType=n04_floor_types, VARUseAllLevelsIgnoresLevelsSelectionFilter=n05_use_all_levels_ignores_levels, VARFixFactorDependsofProjectUnits1Formetersforexampleand100forCentimeters=fix_factor_depends_of_project, VARLevelsSelectionFiltertoRead=n06_levels_selection_filter_to, VAROffset=offset)  # package Synthesize toolkit; Create Floors By Boundary Lines (Smart)

# group: Report
n01_number_of_floors_created = Watch(create_floors_by_boundary_lines.VARNumberofFloorsCreated)  # "01.Number of Floors Created"; graph output

generate_selection_filter = Custom[Generate Selection Filter](VARCreateSelectionFilter=n07_create_selection_filter, VARFilterNametoCreate=n08_filter_name_to_create, VAROverwriteExistingFilter=n09_overwrite_existing_filter, VARElements=create_floors_by_boundary_lines.VARFloors)  # package Synthesize toolkit; Generate Selection FIlter
debug_python = Custom[Debug Python]()  # package Synthesize toolkit; Debug Python
