# Dynamo graph Floors.Create By Pads.dyn (Dynamo 2.13.1.3887)
# author: karam@aecedx.com
# packages: Synthesize toolkit 12.5.1

# group: Input
n08_create_selection_filter_for = BoolSelector(true)  # "08.Create Selection Filter for Newely Created Floors"; graph input
n09_filter_name_for_model_lines = StringInput("Dynamo New Floors By Pads")  # "09.Filter Name for Model Lines of Forced to Spline Floors"; graph input
n10_overwrite_existing_filter = BoolSelector(false)  # "10.Overwrite Existing Filter ? (False for Adding Elements)"; graph input
n01_select_pads = DSModelElementsSelection()  # "01.Select Pads"; nothing selected; graph input
n04_result_floor_boundary_offset = DoubleInput(0)  # "04.Result Floor Boundary Offset"; graph input
n03_floor_type = FloorTypes()  # "03.Floor Type"; nothing selected; graph input
n05_create_model_lines_for_floors = BoolSelector(false)  # "05.Create Model Lines For Floors ? (Use if Revit Deleted Some Resulted Floors)"; graph input
n06_filter_name_for_model_lines = StringInput("Dynamo Floors Model Lines By Pads")  # "06.Filter Name for Model Lines"; graph input
n07_overwrite_existing_filter = BoolSelector(false)  # "07.Overwrite Existing Filter ? (False for Adding Elements)"; graph input
n02_adjust_pads_height_offset = DoubleInput(-0.3)  # "02.Adjust Pads Height Offset"; graph input

floors_offset_and_separate_by = Custom[Floors Offset And Separate By Pads](VARPads=n01_select_pads, VAROffset=n04_result_floor_boundary_offset, VARFloorType=n03_floor_type)  # package Synthesize toolkit; Floors Offset And Separate
generate_selection_filter = Custom[Generate Selection Filter](VARCreateSelectionFilter=n08_create_selection_filter_for, VARFilterNametoCreate=n09_filter_name_for_model_lines, VAROverwriteExistingFilter=n10_overwrite_existing_filter, VARElements=floors_offset_and_separate_by.VARNewFloors)  # package Synthesize toolkit; Generate Selection FIlter
empty = List.Empty()
scopeIf = Custom[CW.ScopeIf+](VARtest=n05_create_model_lines_for_floors, VARtrue=floors_offset_and_separate_by.VARCurves, VARfalse=empty)  # package Synthesize toolkit; A (hopefully) more robust implementation of ScopeIf. Tests a single boolean and returns a value accordingly.
byCurve = ModelCurve.ByCurve(curve=scopeIf)
generate_selection_filter_2 = Custom[Generate Selection Filter](VARCreateSelectionFilter=n05_create_model_lines_for_floors, VARFilterNametoCreate=n06_filter_name_for_model_lines, VAROverwriteExistingFilter=n07_overwrite_existing_filter, VARElements=byCurve)
debug_python = Custom[Debug Python]()  # package Synthesize toolkit; Debug Python
code_block = CodeBlock { "Height Offset From Level"; }
getParameterValueByName = Element.GetParameterValueByName(element=floors_offset_and_separate_by.VARExistedPads, parameterName=code_block)
add = getParameterValueByName + n02_adjust_pads_height_offset
setParameterByName = Element.SetParameterByName(element=floors_offset_and_separate_by.VARExistedPads, parameterName=code_block, value=add, lacing=Longest)
