# Dynamo graph Floors.Create By Roofs.dyn (Dynamo 2.13.1.3887)
# author: karam@aecedx.com
# packages: Synthesize toolkit 12.5.1

# group: Input
n01_select_roofs = DSModelElementsSelection()  # "01.Select Roofs"; nothing selected; graph input
n04_floor_type = FloorTypes()  # "04.Floor Type"; nothing selected; graph input
fix_factor_depends_of_project = DoubleInput(1000)  # "Fix Factor (Depends of Project Units, 1 For meters for example, and 100 for Centimeters)"
n02_boundary_offset = DoubleInput(0)  # "02.Boundary Offset"; graph input
n05_create_selection_filter = BoolSelector(true)  # "05.Create Selection Filter ?"; graph input
n06_filter_name_to_create = StringInput("Dynamo Floors Converted")  # "06.Filter Name to Create"; graph input
n07_overwrite_existing_filter = BoolSelector(false)  # "07.Overwrite Existing Filter ? (False for Adding Elements)"; graph input
n03_height_offset = DoubleInput(0)  # "03.Height Offset"; graph input

string_from_object = FromObject(obj=n01_select_roofs)
code_block = CodeBlock { "FootPrintRoof"; }
eq = string_from_object == code_block
filterByBoolMask = List.FilterByBoolMask(list=n01_select_roofs, mask=eq)
elementSketch = Custom[SP.Collector.ElementSketch](VARelement=filterByBoolMask.in)  # package Synthesize toolkit; Get the actual sketch lines of a sketch based element (floor, ceiling, modified wall, etc.) . You can optionally fetch the matching model curves, however this might prove comptationally heavy on larger data sets.
flatten = List.Flatten(list=elementSketch.VARcurves@L2)
code_block_2 = CodeBlock { "Base Level"; "Base Offset From Level"; }
getParameterValueByName = Element.GetParameterValueByName(element=filterByBoolMask.in, parameterName=code_block_2.out0)
plane = Custom[CW.Level.Plane](VARlevel=getParameterValueByName)  # package Synthesize toolkit; Retrieves the plane of a given level
pullOntoPlane = Curve.PullOntoPlane(curve=flatten, plane=plane, lacing=Longest)
ZAxis = Vector.ZAxis()
getParameterValueByName_2 = Element.GetParameterValueByName(element=filterByBoolMask.in, parameterName=code_block_2.out1)
translate = Geometry.Translate(geometry=pullOntoPlane, direction=ZAxis, distance=getParameterValueByName_2, lacing=Longest)
as_polycurve_bycurves = Custom[AS.[&] PolyCurve.ByCurves](VARcurves=translate)  # package Synthesize toolkit; Create polycurves from an unordered list of curves.
flatten_2 = List.Flatten(list=as_polycurve_bycurves.VARpolyCurve)
code_block_3 = CodeBlock { true; "null"; }
create_floors_by_boundary_lines = Custom[Create Floors By Boundary Lines (Smart)](VARFloorsBoundariesPolycurves=flatten_2, VARFloorType=n04_floor_type, VARUseAllLevelsIgnoresLevelsSelectionFilter=code_block_3.out0, VARFixFactorDependsofProjectUnits1Formetersforexampleand100forCentimeters=fix_factor_depends_of_project, VARLevelsSelectionFiltertoRead=code_block_3.out1, VAROffset=n02_boundary_offset)  # package Synthesize toolkit; Create Floors By Boundary Lines (Smart)

# group: Report
n01_number_of_floors_created = Watch(create_floors_by_boundary_lines.VARNumberofFloorsCreated)  # "01.Number of Floors Created"; graph output

generate_selection_filter = Custom[Generate Selection Filter](VARCreateSelectionFilter=n05_create_selection_filter, VARFilterNametoCreate=n06_filter_name_to_create, VAROverwriteExistingFilter=n07_overwrite_existing_filter, VARElements=create_floors_by_boundary_lines.VARFloors)  # package Synthesize toolkit; Generate Selection FIlter
code_block_4 = CodeBlock { "Height Offset From Level"; }
add = n03_height_offset + getParameterValueByName_2
setParameterByName = Element.SetParameterByName(element=create_floors_by_boundary_lines.VARFloors, parameterName=code_block_4, value=add, lacing=Longest)
debug_python = Custom[Debug Python]()  # package Synthesize toolkit; Debug Python
