# Dynamo graph Floors.Create By Spliting Model Lines.dyn (Dynamo 2.13.1.3887)
# author: karam@aecedx.com
# packages: Synthesize toolkit 12.5.1

# group: Input
n01_select_floors_and_model_lines = DSModelElementsSelection()  # "01.Select Floors and Model Lines"; nothing selected; graph input
n02_boundaries_offset = DoubleInput(0)  # "02.Boundaries Offset"; graph input
n03_delete_old_floors = BoolSelector(true)  # "03.Delete Old Floors ?"; graph input

code_block = CodeBlock { "Floor"; "ModelCurve"; }
byClassName = Custom[SP.Filter.ByClassName](VARobject=n01_select_floors_and_model_lines, VARclassName=code_block.out0)  # package Synthesize toolkit; Filters a list of objects by the object's class name. Note that Dynamo elements belong to different classes than their Revit counterparts. Use the Object.Class node to check an object's class.
element_geometry_fixer = Custom[Element.Geometry Fixer](VARElement=byClassName.VARin)  # package Synthesize toolkit; Element.Geometry Fixer
explode = Geometry.Explode(geometry=element_geometry_fixer)
code_block_2 = CodeBlock { 0.5; }
pointAtParameter = Surface.PointAtParameter(surface=explode, u=code_block_2, v=code_block_2)
Z = Point.Z(point=pointAtParameter)
maximumItem = List.MaximumItem(list=Z)
eq = Z == maximumItem
filterByBoolMask = List.FilterByBoolMask(list=explode, mask=eq)
flatten = List.Flatten(list=filterByBoolMask.in@L2)
byClassName_2 = Custom[SP.Filter.ByClassName](VARobject=n01_select_floors_and_model_lines, VARclassName=code_block.out1)
curves = Element.Curves(element=byClassName_2.VARin)
flatten_2 = List.Flatten(list=curves)
python_script = Python(IN[0]=flatten, IN[1]=byClassName.VARin, IN[2]=flatten_2)  # IronPython2
# ---------- python_script.python (66 lines) ----------
# Enable Python support and load DesignScript library
# IMPORTANT : ALL DYNAMO DESIGN SCRIPT NODES ARE AS (dg)
import clr
clr.AddReference('ProtoGeometry')
from Autodesk.DesignScript import Geometry as dg

# EXTENSION Enable ToDSType
clr.AddReference('RevitNodes')
import Revit
clr.ImportExtensions(Revit.Elements)

# Enable Revit Elements
from Revit.Elements import *

# EXTENSION Enable Geometry Conversion Methods
clr.ImportExtensions(Revit.GeometryConversion)

# Enable Revit API
clr.AddReference('RevitAPI')
from Autodesk.Revit.DB import *

# Enable DocumentManager and TransactionManager
clr.AddReference('RevitServices')
from RevitServices.Persistence import DocumentManager
from RevitServices.Transactions import TransactionManager

# Enable ICollection List Translate
clr.AddReference("System")
import System.Collections.Generic
from System.Collections.Generic import List

dataEnteringNode = IN
# Use UnwrapElement(IN[0]) When Translating From Dynamo to Revit
surfaceLists=UnwrapElement(IN[0])
floors=UnwrapElement(IN[1])
lines=UnwrapElement(IN[2])

# Choose The Current Document
doc = DocumentManager.Instance.CurrentDBDocument
uidoc = DocumentManager.Instance.CurrentUIApplication.ActiveUIDocument
uiapp = DocumentManager.Instance.CurrentUIApplication
app = uiapp.Application

# Create Empty List
result = []

count = 0
groups = []
for surfaceList in surfaceLists:
	floor = floors[count]
	for surface in surfaceList:
		tmp = []
		for line in lines:
			if dg.Geometry.DoesIntersect(surface,line):
				tmp.append(line)
		groups.append([floor,surface,tmp])
	count += 1

# Start a Transaction with Current Document (doc)
TransactionManager.Instance.EnsureInTransaction(doc)

# End the Transaction with Current Document ()
TransactionManager.Instance.TransactionTaskDone()

# Assign your output to the OUT variable.
OUT = groups
# ----------------------------------------
transpose = List.Transpose(lists=python_script)
code_block_3 = CodeBlock(a=transpose) { a[1]; }
code_block_4 = CodeBlock(a=transpose) { a[2]; }
as_geometry_splitbytools = Custom[AS.[&] Geometry.SplitByTools](VARgeometry=code_block_3, VARtools=code_block_4)  # package Synthesize toolkit; Split one piece of geometry (other than a polysurface) by multiple tools
perimeterCurves = Surface.PerimeterCurves(surface=as_geometry_splitbytools)
as_polycurve_bycurves = Custom[AS.[&] PolyCurve.ByCurves](VARcurves=perimeterCurves)  # package Synthesize toolkit; Create polycurves from an unordered list of curves.
count = List.Count(list=as_polycurve_bycurves.VARpolyCurve@@L2)
count_2 = List.Count(list=count@L2)
flatten_3 = List.Flatten(list=as_polycurve_bycurves.VARpolyCurve)
python_script_2 = Python(IN[0]=flatten_3)  # IronPython2
# ---------- python_script_2.python (99 lines) ----------
# Enable Python support and load DesignScript library
# IMPORTANT : ALL DYNAMO DESIGN SCRIPT NODES ARE AS (dg)
import clr
clr.AddReference('ProtoGeometry')
from Autodesk.DesignScript import Geometry as dg

# EXTENSION Enable ToDSType
clr.AddReference('RevitNodes')
import Revit
clr.ImportExtensions(Revit.Elements)

# Enable Revit Elements
from Revit.Elements import *

# EXTENSION Enable Geometry Conversion Methods
clr.ImportExtensions(Revit.GeometryConversion)

# Enable Revit API
clr.AddReference('RevitAPI')
from Autodesk.Revit.DB import *

# Enable DocumentManager and TransactionManager
clr.AddReference('RevitServices')
from RevitServices.Persistence import DocumentManager
from RevitServices.Transactions import TransactionManager

# Enable ICollection List Translate
clr.AddReference("System")
import System.Collections.Generic
from System.Collections.Generic import List

import System
pf_path = System.Environment.GetFolderPath(System.Environment.SpecialFolder.ProgramFilesX86)
import sys
sys.path.append("%s\IronPython 2.7\Lib" %pf_path)

from bisect import bisect_left

dataEnteringNode = IN
# Use UnwrapElement(IN[0]) When Translating From Dynamo to Revit
stuffList=UnwrapElement(IN[0])

# Choose The Current Document
doc = DocumentManager.Instance.CurrentDBDocument
uidoc = DocumentManager.Instance.CurrentUIApplication.ActiveUIDocument
uiapp = DocumentManager.Instance.CurrentUIApplication
app = uiapp.Application

def take_closest(myList, myNumber):
    """
    Assumes myList is sorted. Returns closest value to myNumber.

    If two numbers are equally close, return the smallest number.
    """
    pos = bisect_left(myList, myNumber)
    if pos == 0:
        return myList[0]
    if pos == len(myList):
        return myList[-1]
    before = myList[pos - 1]
    after = myList[pos]
    if after - myNumber < myNumber - before:
        return after
    else:
        return before

if int(DocumentManager.Instance.CurrentUIApplication.Application.VersionNumber) < 2021:
	ToInternalfactor = UnitUtils.ConvertToInternalUnits(1,doc.GetUnits().GetFormatOptions(UnitType.UT_Length).DisplayUnits)
else:
	ToInternalfactor = UnitUtils.ConvertToInternalUnits(1,doc.GetUnits().GetFormatOptions(SpecTypeId.Length).GetUnitTypeId())

levels = list(FilteredElementCollector(doc).OfClass(Level).ToElements())

levels.sort(key=lambda x: x.Elevation, reverse=False)

levelsData = []
for level in levels:
	levelsData.append([level.Name,level.Elevation,level])

result = []
for stuff in stuffList:
	validHeights = []
	compare_pt = round(stuff.StartPoint.Z,6) * ToInternalfactor
	for levelData in levelsData:
		if levelData[1] <= compare_pt:
			validHeights.append(levelData[1])
	closestHeight = take_closest(validHeights,compare_pt)
	for levelData in levelsData:
		if 	levelData[1] == closestHeight:
			levelName = levelData[0]
			wantedLevel = levelData[2]
			wantedOffset = compare_pt - levelData[1]

	result.append([stuff,levelName,wantedLevel,wantedOffset,wantedOffset/ToInternalfactor])

result = map(list, zip(*result))

# Assign your output to the OUT variable.
OUT =  result
# ----------------------------------------
code_block_5 = CodeBlock(a=python_script_2) { a[0]; }
chopByLengths = Custom[CW.List.ChopByLengths](VARlengths=count, VARlist=code_block_5)  # package Synthesize toolkit; Turns a list into a list of lists with sublists of varying lengths.
chopByLengths_2 = Custom[CW.List.ChopByLengths](VARlengths=count_2, VARlist=chopByLengths)
flatten_4 = List.Flatten(list=chopByLengths_2)
code_block_6 = CodeBlock { 1; }
chop = List.Chop(list=flatten_4, lengths=code_block_6)
curves_offset_to_revit = Custom[Curves Offset To Revit Compatibility](VARCurves=chop, VAROffset=n02_boundaries_offset)  # package Synthesize toolkit; Curves Offset To Revit Compatibility
chopByLengths_3 = Custom[CW.List.ChopByLengths](VARlengths=count, VARlist=curves_offset_to_revit.VARCurves)
chopByLengths_4 = Custom[CW.List.ChopByLengths](VARlengths=count_2, VARlist=chopByLengths_3)
byJoinedCurves = PolyCurve.ByJoinedCurves(curves=chopByLengths_4)
count_3 = List.Count(list=byJoinedCurves@@L2)
code_block_7 = CodeBlock { 1; }
eq_2 = count_3 == code_block_7
code_block_8 = CodeBlock(a=transpose) { a[0]; }
elementType = Element.ElementType(element=code_block_8)
code_block_9 = CodeBlock(a=python_script_2) { a[2]; }
chopByLengths_5 = Custom[CW.List.ChopByLengths](VARlengths=count, VARlist=code_block_9)
chopByLengths_6 = Custom[CW.List.ChopByLengths](VARlengths=count_2, VARlist=chopByLengths_5)
firstItem = List.FirstItem(list=chopByLengths_6@@L2)
code_block_10 = CodeBlock(a=python_script_2) { a[3]; }
chopByLengths_7 = Custom[CW.List.ChopByLengths](VARlengths=count, VARlist=code_block_10)
chopByLengths_8 = Custom[CW.List.ChopByLengths](VARlengths=count_2, VARlist=chopByLengths_7)
firstItem_2 = List.FirstItem(list=chopByLengths_8@@L2)
chopByLengths_9 = Custom[CW.List.ChopByLengths](VARlengths=count, VARlist=curves_offset_to_revit.VARRevitCurves)
chopByLengths_10 = Custom[CW.List.ChopByLengths](VARlengths=count_2, VARlist=chopByLengths_9)
byGeometry = BoundingBox.ByGeometry(geom=byJoinedCurves@@L1)
maxPoint = BoundingBox.MaxPoint(boundingBox=byGeometry)
minPoint = BoundingBox.MinPoint(boundingBox=byGeometry)
byStartPointEndPoint = Line.ByStartPointEndPoint(startPoint=maxPoint, endPoint=minPoint)
length = Curve.Length(curve=byStartPointEndPoint)
maximumItem_2 = List.MaximumItem(list=length)
eq_3 = maximumItem_2 == length
filterByBoolMask_2 = List.FilterByBoolMask(list=chopByLengths_10, mask=eq_3)
firstItem_3 = List.FirstItem(list=filterByBoolMask_2.in@@L3)
python_script_3 = Python(IN[0]=elementType, IN[1]=firstItem, IN[2]=firstItem_2, IN[3]=firstItem_3, IN[4]=filterByBoolMask_2.out, IN[5]=code_block_8, IN[6]=n03_delete_old_floors)  # IronPython2
# ---------- python_script_3.python (126 lines) ----------
# Enable Python support and load DesignScript library
# IMPORTANT : ALL DYNAMO DESIGN SCRIPT NODES ARE AS (dg)
import clr
clr.AddReference('ProtoGeometry')
from Autodesk.DesignScript import Geometry as dg

# EXTENSION Enable ToDSType
clr.AddReference('RevitNodes')
import Revit
clr.ImportExtensions(Revit.Elements)

# Enable Revit Elements
from Revit.Elements import *

# EXTENSION Enable Geometry Conversion Methods
clr.ImportExtensions(Revit.GeometryConversion)

# Enable Revit API
clr.AddReference('RevitAPI')
from Autodesk.Revit.DB import *

# Enable DocumentManager and TransactionManager
clr.AddReference('RevitServices')
from RevitServices.Persistence import DocumentManager
from RevitServices.Transactions import TransactionManager

# Enable ICollection List Translate
clr.AddReference("System")
import System.Collections.Generic
from System.Collections.Generic import List

dataEnteringNode = IN
# Use UnwrapElement(IN[0]) When Translating From Dynamo to Revit
floortypes=UnwrapElement(IN[0])
floorlevelsLists=UnwrapElement(IN[1])
flooroffsetsLists=IN[2]
floorLinesLists=UnwrapElement(IN[3])
floorInsidesLists=UnwrapElement(IN[4])
oldelements=UnwrapElement(IN[5])
deleteOld = IN[6]

# Choose The Current Document
doc = DocumentManager.Instance.CurrentDBDocument
uidoc = DocumentManager.Instance.CurrentUIApplication.ActiveUIDocument
uiapp = DocumentManager.Instance.CurrentUIApplication
app = uiapp.Application

# Create Empty List
result = []

# Start a Transaction with Current Document (doc)
TransactionManager.Instance.EnsureInTransaction(doc)

count = 0
for floortype in floortypes:
	floorlevels = floorlevelsLists[count]
	flooroffsets = flooroffsetsLists[count]
	floorLines = floorLinesLists[count]
	floorInsides = floorInsidesLists[count]
	oldelement = oldelements[count]
	count += 1
	
	error = False
	innercount = 0
	for loop in floorLines:
		floorlevel = floorlevels[innercount]
		flooroffset = flooroffsets[innercount]
		
		innerloops = floorInsides[innercount]
		innercount += 1
		
		carray = []
		tmploop = CurveLoop()
		for l in loop:
			tmploop.Append(l)
		carray.append(tmploop)
		
		for innerloop in innerloops:
			tmploop = CurveLoop()
			for l in innerloop:
				tmploop.Append(l)
			carray.append(tmploop)
			
		if int(DocumentManager.Instance.CurrentUIApplication.Application.VersionNumber) < 2022:
			carrayOLD =  CurveArray()
			listcarray = list(carray)
			bigloop = listcarray.pop(0)
			for lo in bigloop:
				carrayOLD.Append(lo)
			try:
				openingactual = None
				floor = doc.Create.NewFloor(carrayOLD,floortype,floorlevel,False)
				floor.get_Parameter(BuiltInParameter.FLOOR_HEIGHTABOVELEVEL_PARAM).Set(flooroffset)
				doc.Regenerate()
				for opening in listcarray:
					openingArray =  CurveArray()
					for op in opening:
						openingArray.Append(op)
						try:
							openingactual = doc.Create.NewOpening(floor,openingArray,False)
						except:
							pass
				result.append([floor,openingactual])
			except:
				result.append([None])
				error = True
		else:
			try:
				floor = Floor.Create(doc,carray,floortype.Id,floorlevel.Id)
				floor.get_Parameter(BuiltInParameter.FLOOR_HEIGHTABOVELEVEL_PARAM).Set(flooroffset)
				result.append([floor])
			except:
				result.append([None])
				error = True
	if error == False and deleteOld:
		try:
			todel = oldelement.Id
			doc.Delete(todel)
		except:
			pass
			
# End the Transaction with Current Document ()
TransactionManager.Instance.TransactionTaskDone()

# Assign your output to the OUT variable.
OUT = result
# ----------------------------------------
debug_python_no_message = Custom[Debug Python No Message]()  # package Synthesize toolkit; Debug Python
