# Dynamo graph Floors.Create Pathways By Lines.dyn (Dynamo 2.13.1.3887)
# author: karam@aecedx.com
# packages: Synthesize toolkit 12.5.1

# group: Input
n01_select_lines = DSModelElementsSelection()  # "01.Select Lines"; nothing selected; graph input
n03_pathway_width = DoubleInput(1)  # "03.Pathway Width"; graph input
n02_create_model_lines_only = BoolSelector(false)  # "02.Create Model Lines Only"; graph input
n04_mode_1_fillet_2_arc_chamfer_3 = IntegerSlider(2, range=1..3 step 1)  # "04.Mode : 1 = Fillet | 2 = Arc Chamfer | 3 = Chamfer"; graph input
n06_radius_or_chamfer_0_disables = DoubleInput(0)  # "06.Radius or Chamfer (0 Disables It)"; graph input
n05_flip_for_arc_chamfer_mode = BoolSelector(true)  # "05.Flip (For Arc Chamfer Mode)"; graph input
n08_create_selection_filters = BoolSelector(true)  # "08.Create Selection Filters"; graph input
n09_filter_name_to_create_for = StringInput("Dynamo Floors By Pathway")  # "09.Filter Name to Create For Result Floors"; graph input
n11_overwrite_existing_filter = BoolSelector(false)  # "11.Overwrite Existing Filter ? (False for Adding Elements)"; graph input
n07_floor_types = FloorTypes()  # "07.Floor Types"; nothing selected; graph input
consider_inner_model_lines_as = BoolSelector(true)  # "Consider Inner Model Lines As Opennings"
n10_filter_name_to_create_for = StringInput("Dynamo Pathway Model Lines")  # "10.Filter Name to Create For Model Lines"; graph input

code_block = CodeBlock { "DetailCurve"; "ModelCurve"; }
byClassName = Custom[SP.Filter.ByClassName](VARobject=n01_select_lines, VARclassName=code_block.out0)  # package Synthesize toolkit; Filters a list of objects by the object's class name. Note that Dynamo elements belong to different classes than their Revit counterparts. Use the Object.Class node to check an object's class.
byClassName_2 = Custom[SP.Filter.ByClassName](VARobject=byClassName.VARout, VARclassName=code_block.out1)
create = List.Create(item0=byClassName.VARin, item1=byClassName_2.VARin)
code_block_2 = CodeBlock { false; }
clean = List.Clean(list=create, preserveIndices=code_block_2)
flatten = List.Flatten(list=clean)
element_geometry_dwg_fixer = Custom[Element.Geometry DWG Fixer](VARElements=flatten)  # package Synthesize toolkit; Element.Geometry DWG Fixer
street_lines_prepare = Custom[Street Lines Prepare](VARCADImport=element_geometry_dwg_fixer, VARStreetWidth=n03_pathway_width)  # package Synthesize toolkit; Street Lines Prepare
eraser = Custom[ST.Tool.Eraser](VARList=street_lines_prepare.VARCADImport)  # package Synthesize toolkit; Try to delete any element from project
empty = List.Empty()
code_block_3 = CodeBlock { 1; 2; 3; }
eq = n04_mode_1_fillet_2_arc_chamfer_3 == code_block_3.out0
code_block_4 = CodeBlock(a=street_lines_prepare.VARCurvesAndSurfaces) { a[1]; }
as_polycurve_bycurves = Custom[AS.[&] PolyCurve.ByCurves](VARcurves=code_block_4)  # package Synthesize toolkit; Create polycurves from an unordered list of curves.
empty_2 = List.Empty()
scopeIf = Custom[CW.ScopeIf+](VARtest=eq, VARtrue=as_polycurve_bycurves.VARpolyCurve, VARfalse=empty_2)  # package Synthesize toolkit; A (hopefully) more robust implementation of ScopeIf. Tests a single boolean and returns a value accordingly.
fillet = Custom[SP.PolyCurve.Fillet+](polycurve=scopeIf, radius=n06_radius_or_chamfer_0_disables)  # package Synthesize toolkit; Fillet a polycurve in its plane. Unlike the built in node, this works in both in the CW and the CCW direction.
eq_2 = n04_mode_1_fillet_2_arc_chamfer_3 == code_block_3.out1
scopeIf_2 = Custom[CW.ScopeIf+](VARtest=eq_2, VARtrue=as_polycurve_bycurves.VARpolyCurve, VARfalse=empty_2)
arcChamfer = Custom[SP.PolyCurve.ArcChamfer](polycurve=scopeIf_2, distance=n06_radius_or_chamfer_0_disables, flip=n05_flip_for_arc_chamfer_mode)  # package Synthesize toolkit; Symmetrically chamfers the corners of the polycurve by the designated distance and close with tangent arcs.
eq_3 = n04_mode_1_fillet_2_arc_chamfer_3 == code_block_3.out2
scopeIf_3 = Custom[CW.ScopeIf+](VARtest=eq_3, VARtrue=as_polycurve_bycurves.VARpolyCurve, VARfalse=empty_2)
chamfer = Custom[SP.PolyCurve.Chamfer](polycurve=scopeIf_3, distance=n06_radius_or_chamfer_0_disables)  # package Synthesize toolkit; Symmetrically chamfers the corners of the polycurve by the designated distance
create_2 = List.Create(item0=fillet, item1=arcChamfer, item2=chamfer)
code_block_5 = CodeBlock { false; }
clean_2 = List.Clean(list=create_2, preserveIndices=code_block_5)
flatten_2 = List.Flatten(list=clean_2)
curves = PolyCurve.Curves(polyCurve=flatten_2)
curves_offset_to_revit = Custom[Curves Offset To Revit Compatibility](VARCurves=curves)  # package Synthesize toolkit; Curves Offset To Revit Compatibility
flatten_3 = List.Flatten(list=curves_offset_to_revit.VARCurves)
byCurve = ModelCurve.ByCurve(curve=flatten_3)
scopeIf_4 = Custom[CW.ScopeIf+](VARtest=n02_create_model_lines_only, VARtrue=empty, VARfalse=byCurve)
use_all_levels_ignores_levels = BoolSelector(true)  # "Use All Levels (Ignores Levels Selection Filter)"
fix_factor_depends_of_project = DoubleInput(1000)  # "Fix Factor (Depends of Project Units, 1 For meters for example, and 100 for Centimeters)"
levels_selection_filter_to_read = StringInput("Levels Filter Name")
offset = DoubleInput(0)
floors_by_model_lines = Custom[Floors By Model Lines](VARCreateSelectionFilter=n08_create_selection_filters, VARFilterNametoCreate=n09_filter_name_to_create_for, VAROverwriteExistingFilter=n11_overwrite_existing_filter, VARFloorType=n07_floor_types, VARUseAllLevelsIgnoresLevelsSelectionFilter=use_all_levels_ignores_levels, VARFixFactorDependsofProjectUnits1Formetersforexampleand100forCentimeters=fix_factor_depends_of_project, VARLevelsSelectionFiltertoRead=levels_selection_filter_to_read, VAROffset=offset, VARConsiderInnerModelLinesAsOpennings=consider_inner_model_lines_as, VARElement=scopeIf_4)  # package Synthesize toolkit; Floors By Model Lines
passthrough = Custom[CW.Passthrough](VARpassThrough=scopeIf_4, VARwaitFor=floors_by_model_lines.VAROutput)  # package Synthesize toolkit; Forces a sequential order of execution. The node wired into the output of the Passthrough node will be executed *after* the node wired into the waitFor input (e.g. important for some Revit operations). The value of the passThrough input will be passed on to the node wired into the output port of the Passthrough node.
eraser_2 = Custom[ST.Tool.Eraser](VARList=passthrough)
debug_python = Custom[Debug Python]()  # package Synthesize toolkit; Debug Python
scopeIf_5 = Custom[CW.ScopeIf+](VARtest=n02_create_model_lines_only, VARtrue=byCurve, VARfalse=empty)
generate_selection_filter = Custom[Generate Selection Filter](VARCreateSelectionFilter=n08_create_selection_filters, VARFilterNametoCreate=n10_filter_name_to_create_for, VAROverwriteExistingFilter=n11_overwrite_existing_filter, VARElements=scopeIf_5)  # package Synthesize toolkit; Generate Selection FIlter
