# Dynamo graph Floors.Modify Sub Elements Match Slope.dyn (Dynamo 2.13.1.3887)
# author: karam@aecedx.com
# packages: Synthesize toolkit 12.5.1

# group: Input
n02_delete_old = BoolSelector(false)  # "02.Delete Old ?"; graph input
n01_select_floors_roofs = DSModelElementsSelection()  # "01.Select Floors/Roofs"; nothing selected; graph input
n03_use_all_levels_ignores_levels = BoolSelector(true)  # "03.Use All Levels (Ignores Levels Selection Filter)"; graph input
n04_levels_selection_filter_to = StringInput("Levels Filter Name")  # "04.Levels Selection Filter to Read"; graph input

code_block = CodeBlock { null; }
scopeIf = Custom[CW.ScopeIf+](VARtest=n02_delete_old, VARtrue=n01_select_floors_roofs, VARfalse=code_block)  # package Synthesize toolkit; A (hopefully) more robust implementation of ScopeIf. Tests a single boolean and returns a value accordingly.
faces = Element.Faces(element=n01_select_floors_roofs)
area = Surface.Area(surface=faces)
maximumItem = List.MaximumItem(list=area@L2)
eq = area == maximumItem  # lacing=Longest
filterByBoolMask = List.FilterByBoolMask(list=faces, mask=eq)
code_block_2 = CodeBlock { 0.5; }
pointAtParameter = Surface.PointAtParameter(surface=filterByBoolMask.in, u=code_block_2, v=code_block_2)
Z = Point.Z(point=pointAtParameter)
maximumItem_2 = List.MaximumItem(list=Z)
hot_index_of_item = Custom[HOT.Index of item](VARList=Z@L2, VARItem=maximumItem_2@L1)  # package Synthesize toolkit; Index of Item on List
getItemAtIndex = List.GetItemAtIndex(list=filterByBoolMask.in@L2, index=hot_index_of_item@L2)
flatten = List.Flatten(list=getItemAtIndex)
perimeterCurves = Surface.PerimeterCurves(surface=flatten)
startPoint = Curve.StartPoint(curve=perimeterCurves)
code_block_3 = CodeBlock { "Family and Type"; }
getParameterValueByName = Element.GetParameterValueByName(element=n01_select_floors_roofs, parameterName=code_block_3)
string_from_object = FromObject(obj=getParameterValueByName)
code_block_4 = CodeBlock { "RoofType"; }
eq_2 = string_from_object == code_block_4
original = Custom[SP.Collector.ElementSketch.Original](VARelement=n01_select_floors_roofs)  # package Synthesize toolkit; Get the actual sketch lines of a sketch based element (floor, ceiling, modified wall, etc.) . You can optionally fetch the matching model curves, however this might prove comptationally heavy on larger data sets. Does not work with elements from linked files.
as_polycurve_bycurves = Custom[AS.[&] PolyCurve.ByCurves](VARcurves=original.VARcurves@L2)  # package Synthesize toolkit; Create polycurves from an unordered list of curves.
flatten_2 = List.Flatten(list=as_polycurve_bycurves.VARpolyCurve)
code_block_5 = CodeBlock { null; }
scopeIf_2 = Custom[CW.ScopeIf+](VARtest=eq_2, VARtrue=flatten_2, VARfalse=code_block_5)
isNull = Object.IsNull(object=scopeIf_2)
filterByBoolMask_2 = List.FilterByBoolMask(list=scopeIf_2, mask=isNull)
filterByBoolMask_3 = List.FilterByBoolMask(list=getParameterValueByName, mask=isNull)
code_block_6 = CodeBlock { true; 0.001; false; }
fix_factor_depends_of_project = DoubleInput(1000)  # "Fix Factor (Depends of Project Units, 1 For meters for example, and 100 for Centimeters)"
code_block_7 = CodeBlock { 0; }
create_roofs_by_boundary_lines = Custom[Create Roofs By Boundary Lines (Smart)](VARRoofsBoundariesPolycurves=filterByBoolMask_2.out, VARRoofType=filterByBoolMask_3.out, VARUseAllLevelsIgnoresLevelsSelectionFilter=n03_use_all_levels_ignores_levels, VARRounding=code_block_6.out1, VARSetOffsetParameter=code_block_6.out0, VARFixFactorDependsofProjectUnits1Formetersforexampleand100forCentimeters=fix_factor_depends_of_project, VARLevelsSelectionFiltertoRead=n04_levels_selection_filter_to, VARRoundingFix=code_block_6.out2, VAROffset=code_block_7)  # package Synthesize toolkit; Create Floors By Boundary Lines (Smart)
scopeIf_3 = Custom[CW.ScopeIf+](VARtest=eq_2, VARtrue=code_block_5, VARfalse=flatten_2)
isNull_2 = Object.IsNull(object=scopeIf_3)
filterByBoolMask_4 = List.FilterByBoolMask(list=scopeIf_3, mask=isNull_2)
filterByBoolMask_5 = List.FilterByBoolMask(list=getParameterValueByName, mask=isNull_2)
create_floors_by_boundary_lines = Custom[Create Floors By Boundary Lines (Smart)](VARFloorsBoundariesPolycurves=filterByBoolMask_4.out, VARFloorType=filterByBoolMask_5.out, VARUseAllLevelsIgnoresLevelsSelectionFilter=n03_use_all_levels_ignores_levels, VARFixFactorDependsofProjectUnits1Formetersforexampleand100forCentimeters=fix_factor_depends_of_project, VARLevelsSelectionFiltertoRead=n04_levels_selection_filter_to, VAROffset=code_block_7)  # package Synthesize toolkit; Create Floors By Boundary Lines (Smart)
mergeByBoolMask = Custom[SP.List.MergeByBoolMask](VARIn=create_roofs_by_boundary_lines.VARRoofs, VAROut=create_floors_by_boundary_lines.VARFloors, VARmask=isNull_2)  # package Synthesize toolkit; Merge two lists by a boolean mask list. The true count in the mask should be the same as the length of the true list and vice versa for the false list.
code_block_8 = CodeBlock { false; }
clean = List.Clean(list=mergeByBoolMask, preserveIndices=code_block_8)
flatten_3 = List.Flatten(list=clean)
slabShapeByPoints = Custom[CW.Floor.SlabShapeByPoints](VARpoints=startPoint@L2, VARfloor=flatten_3@L1)  # package Synthesize toolkit; Transform a slab shape based on a list of XYZs. PLEASE NOTE: Will reset any previous edits on the slab shape.
passthrough = Custom[CW.Passthrough](VARpassThrough=scopeIf, VARwaitFor=slabShapeByPoints)  # package Synthesize toolkit; Forces a sequential order of execution. The node wired into the output of the Passthrough node will be executed *after* the node wired into the waitFor input (e.g. important for some Revit operations). The value of the passThrough input will be passed on to the node wired into the output port of the Passthrough node.
eraser = Custom[ST.Tool.Eraser](VARList=passthrough)  # package Synthesize toolkit; Try to delete any element from project
debug_python = Custom[Debug Python]()  # package Synthesize toolkit; Debug Python
