# Dynamo graph Floors.Modify Sub Elements Set Base Level.dyn (Dynamo 2.13.1.3887)
# author: karam@aecedx.com
# packages: Synthesize toolkit 12.5.1

# group: Input
n01_select_floors_roofs = DSModelElementsSelection()  # "01.Select Floors/Roofs"; nothing selected; graph input
n02_level_to_set = Levels()  # "02.Level to Set"; nothing selected; graph input
n03_adjust_offset = BoolSelector(false)  # "03.Adjust Offset ?"; graph input
n04_offset_value = DoubleInput(0)  # "04.Offset Value"; graph input

code_block = CodeBlock { "Floor"; "FootPrintRoof"; }
byClassName = Custom[SP.Filter.ByClassName](VARobject=n01_select_floors_roofs, VARclassName=code_block.out0)  # package Synthesize toolkit; Filters a list of objects by the object's class name. Note that Dynamo elements belong to different classes than their Revit counterparts. Use the Object.Class node to check an object's class.
filterByString = Custom[ST.List.FilterByString](VARlist=byClassName.VARout, VARString=code_block.out1)  # package Synthesize toolkit; Filter a list by a string match
create = List.Create(item0=byClassName.VARin, item1=filterByString.VARMatch)
python_script = Python(IN[0]=create, IN[1]=n02_level_to_set, IN[2]=n03_adjust_offset, IN[3]=n04_offset_value)  # IronPython2
# ---------- python_script.python (86 lines) ----------
import clr
clr.AddReference('RevitAPI')
from Autodesk.Revit.DB import *
clr.AddReference('RevitServices')
from RevitServices.Persistence import DocumentManager
from RevitServices.Transactions import TransactionManager

def tolist(obj1):
	if hasattr(obj1,'__iter__'): return obj1
	else: return [obj1]

def flatten(x):
    result = []
    for el in x:
        if hasattr(el, "__iter__") and not isinstance(el, basestring):
            result.extend(flatten(el))
        else:
            result.append(el)
    return result

floors = UnwrapElement(flatten(tolist(IN[0])))
wantedlevel = UnwrapElement(IN[1])
changeoffset = IN[2]
extraOffset = IN[3]

doc = DocumentManager.Instance.CurrentDBDocument

if int(DocumentManager.Instance.CurrentUIApplication.Application.VersionNumber) < 2021:
	extraOffset = UnitUtils.ConvertToInternalUnits(extraOffset,doc.GetUnits().GetFormatOptions(UnitType.UT_Length).DisplayUnits)
else:
	extraOffset = UnitUtils.ConvertToInternalUnits(extraOffset,doc.GetUnits().GetFormatOptions(SpecTypeId.Length).GetUnitTypeId())

# Create Empty List
result = []
TransactionManager.Instance.EnsureInTransaction(doc)
for floor in floors:
	try:
		try:
			floorlevelheight = doc.GetElement(floor.LookupParameter("Level").AsElementId()).Elevation
			isroof = False
			fixval = 0
		except:
			floorlevelheight = doc.GetElement(floor.LookupParameter("Base Level").AsElementId()).Elevation
			isroof = True
			fixval = doc.GetElement(floor.GetTypeId()).LookupParameter("Default Thickness").AsDouble()
		try:
			flooroffset = floor.LookupParameter("Height Offset From Level").AsDouble()
		except:
			flooroffset = floor.LookupParameter("Base Offset From Level").AsDouble()
		wantedlevelheight = wantedlevel.Elevation
		leveldifference = wantedlevelheight - floorlevelheight
		vertices = floor.SlabShapeEditor.SlabShapeVertices
		try:
			floor.LookupParameter("Level").Set(wantedlevel.Id)
		except:
			floor.LookupParameter("Base Level").Set(wantedlevel.Id)
		doc.Regenerate()
		for vert in vertices:
			offset = ((vert.Position.Z - wantedlevelheight - flooroffset) - leveldifference) - fixval
			floor.SlabShapeEditor.ModifySubElement(vert,offset)
		if changeoffset:
			try:
				floorlevelheight = doc.GetElement(floor.LookupParameter("Level").AsElementId()).Elevation
			except:
				floorlevelheight = doc.GetElement(floor.LookupParameter("Base Level").AsElementId()).Elevation
			flooroffset = extraOffset
			wantedlevelheight = wantedlevel.Elevation
			leveldifference = wantedlevelheight - floorlevelheight
			vertices = floor.SlabShapeEditor.SlabShapeVertices
			try:
				floor.LookupParameter("Level").Set(wantedlevel.Id)
			except:
				floor.LookupParameter("Base Level").Set(wantedlevel.Id)
			try:
				floor.LookupParameter("Height Offset From Level").Set(flooroffset)
			except:
				floor.LookupParameter("Base Offset From Level").Set(flooroffset)
			for vert in vertices:
				offset = ((vert.Position.Z - wantedlevelheight - flooroffset) - leveldifference) - fixval
				floor.SlabShapeEditor.ModifySubElement(vert,offset) 
		result.append(floor)
	except:
		result.append(None)
TransactionManager.Instance.TransactionTaskDone()                      
  
OUT= result
# ----------------------------------------
debug_python_no_message = Custom[Debug Python No Message]()  # package Synthesize toolkit; Debug Python
