# Dynamo graph Floors.Offset and Separate.dyn (Dynamo 2.13.1.3887)
# author: karam@aecedx.com
# packages: Synthesize toolkit 12.5.1

# group: Input
n06_delete_old_floors_false_will = BoolSelector(true)  # "06.Delete Old Floors (False Will Save in Selection Filter)"; graph input
n07_filters_name_to_save_old = StringInput("Dynamo Old Floors")  # "07.Filters Name to Save Old Floors In"; graph input
n01_select_floors = DSModelElementsSelection()  # "01.Select Floors"; nothing selected; graph input
offset = DoubleInput(0)  # "02.Offset"; graph input
n05_floor_type_to_override_with = FloorTypes()  # "05.Floor Type To Override With"; nothing selected; graph input
n04_override_floor_types = BoolSelector(false)  # "04.Override Floor Types ?"; graph input
n03_spline_segmentation_distance = DoubleInput(0)  # "03.Spline Segmentation Distance (0 to Leave as Spline)"; graph input
n11_create_selection_filter_for = BoolSelector(true)  # "11.Create Selection Filter for Newely Created Floors"; graph input
n12_filter_name_for_model_lines = StringInput("Dynamo New Floors")  # "12.Filter Name for Model Lines of Forced to Spline Floors"; graph input
n13_overwrite_existing_filter = BoolSelector(false)  # "13.Overwrite Existing Filter ? (False for Adding Elements)"; graph input
n08_create_model_lines_for_floors = BoolSelector(false)  # "08.Create Model Lines For Floors ? (Use if Revit Deleted Some Resulted Floors)"; graph input
n09_filter_name_for_model_lines = StringInput("Dynamo Floors Model Lines")  # "09.Filter Name for Model Lines"; graph input
n10_overwrite_existing_filter = BoolSelector(false)  # "10.Overwrite Existing Filter ? (False for Adding Elements)"; graph input

code_block = CodeBlock { true; false; }
scopeIf = Custom[CW.ScopeIf+](VARtest=n06_delete_old_floors_false_will, VARtrue=code_block.out1, VARfalse=code_block.out0)  # package Synthesize toolkit; A (hopefully) more robust implementation of ScopeIf. Tests a single boolean and returns a value accordingly.
code_block_2 = CodeBlock { false; }
empty = List.Empty()
update_dynamo_wait = Custom[Update Dynamo Wait](VARWait=n01_select_floors)  # package Synthesize toolkit; Update Dynamo Wait
floors_offset_and_separate = Custom[Floors Offset And Separate](VARFloors=update_dynamo_wait, VAROffset=offset, VARFloorType=n05_floor_type_to_override_with, VAROverrideFloorTypes=n04_override_floor_types, VARSplineSegmentationDistance=n03_spline_segmentation_distance)  # package Synthesize toolkit; Floors Offset And Separate
scopeIf_2 = Custom[CW.ScopeIf+](VARtest=n06_delete_old_floors_false_will, VARtrue=empty, VARfalse=floors_offset_and_separate.VARExistedFloors)
generate_selection_filter = Custom[Generate Selection Filter](VARCreateSelectionFilter=scopeIf, VARFilterNametoCreate=n07_filters_name_to_save_old, VAROverwriteExistingFilter=code_block_2, VARElements=scopeIf_2)  # package Synthesize toolkit; Generate Selection FIlter
scopeIf_3 = Custom[CW.ScopeIf+](VARtest=n06_delete_old_floors_false_will, VARtrue=floors_offset_and_separate.VARExistedFloors, VARfalse=empty)
eraser = Custom[ST.Tool.Eraser](VARList=scopeIf_3)  # package Synthesize toolkit; Try to delete any element from project
generate_selection_filter_2 = Custom[Generate Selection Filter](VARCreateSelectionFilter=n11_create_selection_filter_for, VARFilterNametoCreate=n12_filter_name_for_model_lines, VAROverwriteExistingFilter=n13_overwrite_existing_filter, VARElements=floors_offset_and_separate.VARNewFloors)
scopeIf_4 = Custom[CW.ScopeIf+](VARtest=n08_create_model_lines_for_floors, VARtrue=floors_offset_and_separate.VARCurves, VARfalse=empty)
byCurve = ModelCurve.ByCurve(curve=scopeIf_4)
generate_selection_filter_3 = Custom[Generate Selection Filter](VARCreateSelectionFilter=n08_create_model_lines_for_floors, VARFilterNametoCreate=n09_filter_name_for_model_lines, VAROverwriteExistingFilter=n10_overwrite_existing_filter, VARElements=byCurve)
debug_python = Custom[Debug Python]()  # package Synthesize toolkit; Debug Python
