# Dynamo graph FormIt.Detect Solids.dyn (Dynamo 2.13.1.3887)
# author: karam@aecedx.com
# FormIt Dynamo template.

# group: Input
selectFromFormIt = FormItSelectionNode(m_FormItSelection="[{\"ids\":[{\"History\":0,\"Object\":266,\"objectName\":\"ObjectHistoryID\"}],\"objectName\":\"GroupInstancePath\"}]", ButtonText="Select From FormIt")  # "01.FormIt.SelectFromFormIt"; graph input
n02_report_offset = DoubleInput(5)  # "02.Report Offset"; graph input
n03_report_scale = DoubleInput(5)  # "03.Report Scale"; graph input
n04_report_thickness = DoubleInput(1)  # "04.Report Thickness"; graph input

python_script = Python(IN[0]=selectFromFormIt)  # IronPython2
# ---------- python_script.python (49 lines) ----------
# Load the Python Standard and DesignScript Libraries
import sys
import clr
clr.AddReference('ProtoGeometry')
from Autodesk.DesignScript import Geometry as dg

def tolist(obj1):
	if hasattr(obj1,'__iter__'): return obj1
	else: return [obj1]

def flatten(x):
    result = []
    for el in x:
        if hasattr(el, "__iter__") and not isinstance(el, basestring):
            result.extend(flatten(el))
        else:
            result.append(el)
    return result

# The inputs to this node will be stored as a list in the IN variables.
dataEnteringNode = IN

geominput = flatten(tolist(IN[0]))

result = []
for g in geominput:
	if isinstance(g,dg.Surface):
		result.append(False)
	elif isinstance(g,dg.Solid):
		result.append(True)

truenum = sum(result)
falsenum = len(result) - truenum

if truenum == 0 and falsenum == 0:
	result = "ERROR, NO GEOMETRY DETECTED"
elif truenum == 0:
	result = "No Solids Detected"
elif truenum > 0 and falsenum != 0:
	result = str(truenum) + " Solids\n" + str(falsenum) + " Surfaces"
else:
	if truenum == 1:
		solid = " Solid"
	else:
		solid = " Solids" 
	result = "Good Job, Everything is Solid\n" + str(truenum) + solid

# Assign your output to the OUT variable.
OUT =  result
# ----------------------------------------
code_block = CodeBlock { "Arial"; }
byGeometry = BoundingBox.ByGeometry(geom=selectFromFormIt)
maxPoint = BoundingBox.MaxPoint(boundingBox=byGeometry)
ZAxis = Vector.ZAxis()
translate = Geometry.Translate(geometry=maxPoint, direction=ZAxis, distance=n02_report_offset)
textOutlines = FormIt.TextOutlines(text=python_script, fontName=code_block, origin=translate)
byOriginNormal = Plane.ByOriginNormal(origin=translate)
scale = Geometry.Scale(geometry=textOutlines, plane=byOriginNormal, xamount=n03_report_scale, yamount=n03_report_scale, zamount=n03_report_scale)
byPatch = Surface.ByPatch(closedCurve=scale)
count = List.Count(list=byPatch@L2)
code_block_2 = CodeBlock { 1; }
eq = count == code_block_2
filterByBoolMask = List.FilterByBoolMask(list=byPatch, mask=eq)
firstItem = List.FirstItem(list=filterByBoolMask.out@L2)
lastItem = List.LastItem(list=filterByBoolMask.out@L2)
doesIntersect = Geometry.DoesIntersect(geometry=firstItem, other=lastItem)
filterByBoolMask_2 = List.FilterByBoolMask(list=firstItem, mask=doesIntersect)
filterByBoolMask_3 = List.FilterByBoolMask(list=lastItem, mask=doesIntersect)
difference = Surface.Difference(surface=filterByBoolMask_2.in, others=filterByBoolMask_3.in)
filterByBoolMask_4 = List.FilterByBoolMask(list=filterByBoolMask.out, mask=doesIntersect)
list_create = List.Create(item0=filterByBoolMask.in, item1=difference, item2=filterByBoolMask_4.out)
code_block_3 = CodeBlock { false; }
clean = List.Clean(list=list_create, preserveIndices=code_block_3)
flatten = List.Flatten(list=clean)
thicken = Surface.Thicken(surface=flatten, thickness=n04_report_thickness)
XAxis = Vector.XAxis()
code_block_4 = CodeBlock { 90; }
rotate = Geometry.Rotate(geometry=thicken, origin=translate, axis=XAxis, degrees=code_block_4)
code_block_5 = CodeBlock { false; }
setAsMesh = FormItGroupOptions.SetAsMesh(SetAsMesh=code_block_5)
sendToFormIt = BakeNodeWithOptionsNodeModel(geometry=rotate, FormItGroupOptions=setAsMesh)  # graph output
