# Dynamo graph FormIt.K-Paneling Frame.dyn (Dynamo 2.13.1.3887)
# author: karam@aecedx.com
# packages: Synthesize toolkit 12.5.1

# group: Input
selectFromFormIt = FormItSelectionNode(ButtonText="Select From FormIt")  # "01.FormIt.SelectFromFormIt"; graph input
n02_faces_offset = DoubleInput(0)  # "02.Faces Offset"; graph input
n04_border_depth = DoubleInput(0.2)  # "04.Border Depth"; graph input
n03_border_width = DoubleInput(0.1)  # "03.Border Width"; graph input

explode = Geometry.Explode(geometry=selectFromFormIt)
flatten = List.Flatten(list=explode)
python_script = Python(IN[0]=flatten, IN[1]=n02_faces_offset)  # IronPython2
# ---------- python_script.python (95 lines) ----------
# Enable Python support and load DesignScript library
# IMPORTANT : ALL DYNAMO DESIGN SCRIPT NODES ARE AS (dg)
import clr
clr.AddReference('ProtoGeometry')
from Autodesk.DesignScript import Geometry as dg

# Enable ICollection List Translate
clr.AddReference("System")
import System.Collections.Generic
from System.Collections.Generic import List

surfaces = IN[0]
offsetvalue = IN[1]

fixedlist = []
for s in surfaces:
	fixedlist.append(s)
surfaces = fixedlist

def joinonesurf(surfaces):
	backuplist = []
	for s in surfaces:
		backuplist.append(s)
	surftojoin = surfaces.pop(0)
	counter = 0
	result = []
	for s in surfaces:
		bbox1 = s.BoundingBox
		bbox2 = surftojoin.BoundingBox
		if dg.BoundingBox.Intersects(bbox1, bbox2):
			if dg.Geometry.DoesIntersect(surftojoin,s):
				try:
					result = dg.Surface.ByUnion([surftojoin,s])
				except:
					result = dg.PolySurface.ByJoinedSurfaces([surftojoin,s])
				break
		counter += 1
	if result != []:
		surfaces.append(result)
		surfaces.pop(counter)
	else:
		surfaces = rotate(backuplist,-1)
	totallystop = True
	for s in surfaces:
		for s1 in surfaces:
			if dg.Geometry.DoesIntersect(s,s1) and s != s1:
				totallystop = False
				break
		if totallystop == False:
			break
	return surfaces,totallystop
	
def rotate(l, n):
    return l[n:] + l[:n]

def flatten(x):
    result = []
    for el in x:
        if hasattr(el, "__iter__") and not isinstance(el, basestring):
            result.extend(flatten(el))
        else:
            result.append(el)
    return result

if offsetvalue > 0:
	totallystop = False
	while totallystop == False:
		doit = joinonesurf(surfaces)
		surfaces = doit[0]
		totallystop = doit[1]
	
	finalsurfaces = []
	for s in surfaces:
		try:
			offset = dg.Surface.Offset(s,0)
			offset.Dispose()
			finalsurfaces.append(s)
		except:
			exploded = dg.Geometry.Explode(s)
			finalsurfaces.append(exploded)
	
	finalsurfaces = flatten(finalsurfaces)
	
	offset = []
	for f in finalsurfaces:
		try:
			offset.append(dg.Geometry.Explode(dg.Surface.Offset(f,offsetvalue)))
		except:
			pass
	offset = flatten(offset)
else:
	offset = surfaces

# Assign your output to the OUT variable.
OUT = offset
# ----------------------------------------
explode_2 = Geometry.Explode(geometry=python_script)
flatten_2 = List.Flatten(list=explode_2)
k_paneling_framing_only_sandbox = Custom[K-Paneling Framing Only Sandbox](VARSuraces=flatten_2, VARFrameDepth=n04_border_depth, VARFrameWidth=n03_border_width)  # package Synthesize toolkit; Create Frames By Surfaces
code_block = CodeBlock { false; }
clean = List.Clean(list=k_paneling_framing_only_sandbox.VARFrameSolids, preserveIndices=code_block)
flatten_3 = List.Flatten(list=clean)
code_block_2 = CodeBlock { false; }
setAsMesh = FormItGroupOptions.SetAsMesh(SetAsMesh=code_block_2)
sendToFormIt = BakeNodeWithOptionsNodeModel(geometry=flatten_3, FormItGroupOptions=setAsMesh)  # graph output
