# Dynamo graph FormIt.K-Paneling Glazed By Voronoi.dyn (Dynamo 2.13.1.3887)
# author: karam@aecedx.com
# packages: Synthesize toolkit 12.5.1

# group: Input
voronoi_x_scale = DoubleInput(1)
voronoi_y_scale = DoubleInput(1)
voronoi_z_scale = DoubleInput(1)
selectFromFormIt = FormItSelectionNode(m_FormItSelection="[{\"ids\":[{\"History\":0,\"Object\":41,\"objectName\":\"ObjectHistoryID\"}],\"objectName\":\"GroupInstancePath\"},{\"ids\":[{\"History\":0,\"Object\":45,\"objectName\":\"ObjectHistoryID\"}],\"objectName\":\"GroupInstancePath\"}]", ButtonText="Select From FormIt")  # "01.FormIt.SelectFromFormIt"; graph input
n02_faces_offset = DoubleInput(0)  # "02.Faces Offset"; graph input
n04_voronoi_method_false_by = BoolSelector(false)  # "04.Voronoi Method (False = By Number | True = Spacing)"; graph input
n03_voronoi_u_density = DoubleInput(10)  # "03.Voronoi U Density"; graph input
n05_voronoi_v_density_preferred = DoubleInput(10)  # "05.Voronoi V Density (Preferred Same or Less Than U)"; graph input
n06_voronoi_straightness_factor = DoubleInput(1.25)  # "06.Voronoi Straightness Factor"; graph input
n09_border_depth = DoubleInput(0.1)  # "09.Border Depth"; graph input
n08_border_width = DoubleInput(0.1)  # "08.Border Width"; graph input
n11_voronoi_mullion_width = DoubleInput(0.1)  # "11.Voronoi Mullion Width"; graph input
n12_voronoi_mullion_depth = DoubleInput(0.1)  # "12.Voronoi Mullion Depth"; graph input
n15_panels_thickness = DoubleInput(0.03)  # "15.Panels Thickness"; graph input
n13_create_panels = BoolSelector(true)  # "13.Create Panels ?"; graph input
n10_voronoi_mullion_offset = DoubleInput(0)  # "10.Voronoi Mullion Offset"; graph input
n14_panels_offset = DoubleInput(0)  # "14.Panels Offset"; graph input
n07_border_offset = DoubleInput(0)  # "07.Border Offset"; graph input

explode = Geometry.Explode(geometry=selectFromFormIt)
flatten = List.Flatten(list=explode)
python_script = Python(IN[0]=flatten, IN[1]=n02_faces_offset)  # IronPython2
# ---------- python_script.python (95 lines) ----------
# Enable Python support and load DesignScript library
# IMPORTANT : ALL DYNAMO DESIGN SCRIPT NODES ARE AS (dg)
import clr
clr.AddReference('ProtoGeometry')
from Autodesk.DesignScript import Geometry as dg

# Enable ICollection List Translate
clr.AddReference("System")
import System.Collections.Generic
from System.Collections.Generic import List

surfaces = IN[0]
offsetvalue = IN[1]

fixedlist = []
for s in surfaces:
	fixedlist.append(s)
surfaces = fixedlist

def joinonesurf(surfaces):
	backuplist = []
	for s in surfaces:
		backuplist.append(s)
	surftojoin = surfaces.pop(0)
	counter = 0
	result = []
	for s in surfaces:
		bbox1 = s.BoundingBox
		bbox2 = surftojoin.BoundingBox
		if dg.BoundingBox.Intersects(bbox1, bbox2):
			if dg.Geometry.DoesIntersect(surftojoin,s):
				try:
					result = dg.Surface.ByUnion([surftojoin,s])
				except:
					result = dg.PolySurface.ByJoinedSurfaces([surftojoin,s])
				break
		counter += 1
	if result != []:
		surfaces.append(result)
		surfaces.pop(counter)
	else:
		surfaces = rotate(backuplist,-1)
	totallystop = True
	for s in surfaces:
		for s1 in surfaces:
			if dg.Geometry.DoesIntersect(s,s1) and s != s1:
				totallystop = False
				break
		if totallystop == False:
			break
	return surfaces,totallystop
	
def rotate(l, n):
    return l[n:] + l[:n]

def flatten(x):
    result = []
    for el in x:
        if hasattr(el, "__iter__") and not isinstance(el, basestring):
            result.extend(flatten(el))
        else:
            result.append(el)
    return result

if offsetvalue > 0:
	totallystop = False
	while totallystop == False:
		doit = joinonesurf(surfaces)
		surfaces = doit[0]
		totallystop = doit[1]
	
	finalsurfaces = []
	for s in surfaces:
		try:
			offset = dg.Surface.Offset(s,0)
			offset.Dispose()
			finalsurfaces.append(s)
		except:
			exploded = dg.Geometry.Explode(s)
			finalsurfaces.append(exploded)
	
	finalsurfaces = flatten(finalsurfaces)
	
	offset = []
	for f in finalsurfaces:
		try:
			offset.append(dg.Geometry.Explode(dg.Surface.Offset(f,offsetvalue)))
		except:
			pass
	offset = flatten(offset)
else:
	offset = surfaces

# Assign your output to the OUT variable.
OUT = offset
# ----------------------------------------
explode_2 = Geometry.Explode(geometry=python_script)
flatten_2 = List.Flatten(list=explode_2)
smart_voronoi_generator_sandbox = Custom[Smart Voronoi Generator Sandbox](VARSurfaces=flatten_2, VARDistancingMethodFalseIsNumbers=n04_voronoi_method_false_by, VARUDensity=n03_voronoi_u_density, VARVDensity=n05_voronoi_v_density_preferred, VARStraightness=n06_voronoi_straightness_factor)  # package Synthesize toolkit; Smart Voronoi Generator
number_distance_u = DoubleInput(0)
count = List.Count(list=flatten_2)
cycle = List.Cycle(list=number_distance_u, amount=count)
number_distance_v = DoubleInput(0)
cycle_2 = List.Cycle(list=number_distance_v, amount=count)
u_spacing_method_false_by_number = BoolSelector(false)  # "U Spacing Method (False = By Number | True = Spacing)"
v_spacing_method_false_by_number = BoolSelector(false)  # "V Spacing Method (False = By Number | True = Spacing)"
v_mullion_width = DoubleInput(0.2)
v_mullion_depth = DoubleInput(0.1)
v_offset = DoubleInput(0)
k_paneling_sandbox = Custom[K-Paneling Sandbox](VARSurfaces=smart_voronoi_generator_sandbox.VARSurfaces, VARBorderDepth=n09_border_depth, VARBorderWidth=n08_border_width, VARDistanceU=cycle, VARDistanaceV=cycle_2, VARMethodU=u_spacing_method_false_by_number, VARMethodV=v_spacing_method_false_by_number, VARUWidth=n11_voronoi_mullion_width, VARUDepth=n12_voronoi_mullion_depth, VARVWidth=v_mullion_width, VARVDepth=v_mullion_depth, VARPanelThickness=n15_panels_thickness, VARCreatePanels=n13_create_panels, VARCustomGridU=smart_voronoi_generator_sandbox.VARJoinedCurves, VARUOffset=n10_voronoi_mullion_offset, VARVOffset=v_offset, VARPanelOffset=n14_panels_offset, VARBorderOffset=n07_border_offset)  # package Synthesize toolkit; K-Paneling
code_block = CodeBlock { 0; 1; 2; }

# group: Mullions
getItemAtIndex = List.GetItemAtIndex(list=k_paneling_sandbox, index=code_block.out0)

code_block_2 = CodeBlock { false; }
clean = List.Clean(list=getItemAtIndex, preserveIndices=code_block_2)
flatten_3 = List.Flatten(list=clean)
code_block_3 = CodeBlock { false; }
setAsMesh = FormItGroupOptions.SetAsMesh(SetAsMesh=code_block_3)
sendToFormIt = BakeNodeWithOptionsNodeModel(geometry=flatten_3, FormItGroupOptions=setAsMesh)  # graph output

# group: Panels
getItemAtIndex_2 = List.GetItemAtIndex(list=k_paneling_sandbox, index=code_block.out1)

clean_2 = List.Clean(list=getItemAtIndex_2, preserveIndices=code_block_2)
flatten_4 = List.Flatten(list=clean_2)
sendToFormIt_2 = BakeNodeWithOptionsNodeModel(geometry=flatten_4, FormItGroupOptions=setAsMesh)  # graph output

# group: Frames
getItemAtIndex_3 = List.GetItemAtIndex(list=k_paneling_sandbox, index=code_block.out2)

clean_3 = List.Clean(list=getItemAtIndex_3, preserveIndices=code_block_2)
flatten_5 = List.Flatten(list=clean_3)
sendToFormIt_3 = BakeNodeWithOptionsNodeModel(geometry=flatten_5, FormItGroupOptions=setAsMesh)  # graph output
