# Dynamo graph Grid.Auto Re-Name By Intersect Order of Spline.dyn (Dynamo 2.13.1.3887)
# author: karam@aecedx.com
# packages: Synthesize toolkit 12.5.1

n01_select_line = DSModelElementSelection()  # "01.Select Line"; nothing selected; graph input
n02_number_false_letter_true = BoolSelector(true)  # "02.Number = False | Letter = True"; graph input
n03_grid_letter = StringInput("A")  # "03.Grid Letter"; graph input
n04_grid_number = DoubleInput(1)  # "04.Grid Number"; graph input
scopeIf = Custom[CW.ScopeIf+](VARtest=n02_number_false_letter_true, VARtrue=n03_grid_letter, VARfalse=n04_grid_number)  # package Synthesize toolkit; A (hopefully) more robust implementation of ScopeIf. Tests a single boolean and returns a value accordingly.
renumberGridsByCurve = Custom[RH.Rhythm.RenumberGridsByCurve](VARmodelCurve=n01_select_line, VARstartCharacter=scopeIf)  # package Synthesize toolkit; This node will renumber grids in order of curve drawn through them. Select either letters or numbers. (Alphanumeric coming soon)
debug_python = Custom[Debug Python]()  # package Synthesize toolkit; Debug Python
