# Dynamo graph Groups.Delete Unplaced.dyn (Dynamo 2.13.1.3887)
# author: karam@aecedx.com
# packages: Synthesize toolkit 12.5.1

# group: Input
proceed = BoolSelector(false)  # "03.Proceed"; graph input
n01_unplaced_group_to_delete = StringInput("Group 1")  # "01.Unplaced Group to Delete - Leave Empty To Search For All"; graph input
n02_exact_name_false_contains = BoolSelector(false)  # "02.Exact Name = False | Contains Name = True"; graph input

toLower = String.ToLower(string=n01_unplaced_group_to_delete)
code_block = CodeBlock { ""; }
eq = toLower == code_block
al_get_unplaced_groups = Custom[AL.Get Unplaced Groups]()  # package Synthesize toolkit; This node will retrieve all unplaced groups in the model.
toLower_2 = String.ToLower(string=al_get_unplaced_groups.VARGroupNames)
contains = String.Contains(string=toLower_2, searchFor=toLower)
eq_2 = contains == toLower
eq_3 = toLower_2 == toLower
scopeIf = Custom[CW.ScopeIf+](VARtest=n02_exact_name_false_contains, VARtrue=eq_2, VARfalse=eq_3)  # package Synthesize toolkit; A (hopefully) more robust implementation of ScopeIf. Tests a single boolean and returns a value accordingly.
filterByBoolMask = List.FilterByBoolMask(list=al_get_unplaced_groups.VARGroups, mask=scopeIf)
scopeIf_2 = Custom[CW.ScopeIf+](VARtest=eq, VARtrue=al_get_unplaced_groups.VARGroups, VARfalse=filterByBoolMask.in)
flatten = List.Flatten(list=scopeIf_2)
code_block_2 = CodeBlock { null; }
scopeIf_3 = Custom[CW.ScopeIf+](VARtest=proceed, VARtrue=flatten, VARfalse=code_block_2)
eraser = Custom[ST.Tool.Eraser](VARList=scopeIf_3)  # package Synthesize toolkit; Try to delete any element from project
count = List.Count(list=flatten)
code_block_3 = CodeBlock { 6; " / "; }
code_block_4 = CodeBlock { "Family Name"; }
getParameterValueByName = Element.GetParameterValueByName(element=al_get_unplaced_groups.VARGroups, parameterName=code_block_4)
removeFromEnd = Custom[RA.String.RemoveFromEnd](VARStr=getParameterValueByName, VARNumberToRemove=code_block_3.out0)  # package Synthesize toolkit; Remove characters from the end of a string by a given amount
code_block_5 = CodeBlock(a=al_get_unplaced_groups.VARGroupNames, b=code_block_3.out1, c=removeFromEnd) { a+b+c; }
filterByBoolMask_2 = List.FilterByBoolMask(list=code_block_5, mask=scopeIf)
scopeIf_4 = Custom[CW.ScopeIf+](VARtest=eq, VARtrue=code_block_5, VARfalse=filterByBoolMask_2.in)
flatten_2 = List.Flatten(list=scopeIf_4)
isEmpty = List.IsEmpty(list=flatten_2)
code_block_6 = CodeBlock { "No Groups to Remove"; }
scopeIf_5 = Custom[CW.ScopeIf+](VARtest=isEmpty, VARtrue=code_block_6, VARfalse=flatten_2)

# group: Report
n01_number_of_groups_to_delete = Watch(count)  # "01.Number of Groups to Delete"; graph output
n02_group_names_to_delete = Watch(scopeIf_5)  # "02.Group Names to Delete"; graph output

debug_python_no_message = Custom[Debug Python No Message]()  # package Synthesize toolkit; Debug Python
