# Dynamo graph Groups.K-Array With Curves Selection.dyn (Dynamo 2.13.1.3887)
# author: karam@aecedx.com
# packages: Synthesize toolkit 12.5.1

# group: Input
n20_number_of_elements_to_remove = DoubleInput(0)  # "20.Number of Elements to Remove after Array (Negative to Remove from the End)"; graph input
n21_remove_from_both_start_and = BoolSelector(false)  # "21.Remove from Both Start and End ?"; graph input
disable_rotations = BoolSelector(false)
n17_minimum_random_rotation_angle = DoubleSlider(0, range=-360..360 step 1)  # "17.Minimum Random Rotation Angle (Useful When Randomize Rotations is Activated)"; graph input
n18_maximum_random_rotation_angle = DoubleSlider(360, range=-360..360 step 1)  # "18.Maximum Random Rotation Angle (Useful When Randomize Rotations is Activated)"; graph input
n16_randomize_rotations = BoolSelector(false)  # "16.Randomize Rotations ?"; graph input
n15_rotation_angle_to_add_can_be = DoubleInput(0)  # "15.Rotation Angle to Add (Can be 0)"; graph input
n01_select_group = DSModelElementSelection()  # "01.Select Group"; nothing selected; graph input
n04_by_distance_false_by_number = BoolSelector(false)  # "04.By Distance = False | By Number = True"; graph input
n10_by_distance_start_offset = DoubleInput(0)  # "10.By Distance : Start Offset"; graph input
n05_by_distance_distances = DoubleInput(50)  # "05.By Distance : Distances"; graph input
n12_by_number_start_ratio = DoubleSlider(0, range=0..1 step 0.01)  # "12.By Number : Start Ratio"; graph input
n13_by_number_end_ratio = DoubleSlider(1, range=0..1 step 0.01)  # "13.By Number : End Ratio"; graph input
n06_by_distance_center = BoolSelector(false)  # "06.By Distance : Center Justification"; graph input
n14_by_number_position = DoubleSlider(0, range=0..1 step 0.01)  # "14.By Number : Position Justification (0 to 1)"; graph input
n11_by_number_number_of_items = DoubleInput(15)  # "11.By Number : Number of Items"; graph input
n03_offset_closed_loops = DoubleInput(0)  # "03.Offset (Closed Loops Recommended)"; graph input
n19_reverse_array_direction = BoolSelector(false)  # "19.Reverse Array Direction"; graph input
n02_select_path_s = DSModelElementsSelection()  # "02.Select Path(s)"; nothing selected; graph input
n07_by_distance_justify_each_line = BoolSelector(false)  # "07.By Distance : Justify Each Line Separately"; graph input
n08_by_distance_force_start = BoolSelector(false)  # "08.By Distance : Force Start ?"; graph input
n09_by_distance_force_end = BoolSelector(false)  # "09.By Distance : Force End ?"; graph input
n22_create_selection_filter = BoolSelector(true)  # "22.Create Selection Filter ?"; graph input
n23_filter_name_to_create = StringInput("Dynamo K-Array Links")  # "23.Filter Name to Create"; graph input
n24_overwrite_existing_filter = BoolSelector(false)  # "24.Overwrite Existing Filter ? (False for Adding Elements)"; graph input

elementType = Element.ElementType(element=n01_select_group)
curves = Element.Curves(element=n02_select_path_s)
k_array_for_groups = Custom[K-Array For Groups](VARNumberofElementstoRemoveafterArrayNegativetoRemovefromtheEnd=n20_number_of_elements_to_remove, VARRemovefromBothStartandEnd=n21_remove_from_both_start_and, VARDisableRotations=disable_rotations, VARMinimumRandomRotationAngleUsefulWhenRandomizeRotationsisActivated=n17_minimum_random_rotation_angle, VARMaximumRandomRotationAngleUsefulWhenRandomizeRotationsisActivated=n18_maximum_random_rotation_angle, VARRandomizeRotations=n16_randomize_rotations, VARRotationAngletoAddCanbe0=n15_rotation_angle_to_add_can_be, VARgroupType=elementType, VARByDistance=n04_by_distance_false_by_number, VARByDistanceStartOffset=n10_by_distance_start_offset, VARByDistanceDistances=n05_by_distance_distances, VARByNumberStartRatio=n12_by_number_start_ratio, VARByNumberEndRatio=n13_by_number_end_ratio, VARByDistanceCenterJustification=n06_by_distance_center, VARByNumberPositionJustification0to1=n14_by_number_position, VARByNumberNumberofItems=n11_by_number_number_of_items, VAROffsetClosedLoopsRecommended=n03_offset_closed_loops, VARReverseArrayDirection=n19_reverse_array_direction, VARCurves=curves, VARByDistanceJustifyEachLineSeparately=n07_by_distance_justify_each_line, VARByDistanceForceStart=n08_by_distance_force_start, VARByDistanceForceEnd=n09_by_distance_force_end)  # package Synthesize toolkit; K-Array By Levels

# group: Report
n01_spaces_report = Watch(k_array_for_groups.VARSpacesReport)  # "01.Spaces Report"; graph output
n02_number_of_links_placed_per = Watch(k_array_for_groups.VARNumberofFamiliesPlacedPerPath)  # "02.Number of Links Placed Per Path"; graph output
n03_total_links_placed = Watch(k_array_for_groups.VARTotalFamiliesPlaced)  # "03.Total Links Placed"; graph output

removeListFromList = Custom[RH.RemoveListFromList](VARListA=k_array_for_groups.VARElements, VARListB=k_array_for_groups.VARElementstoErase)  # package Synthesize toolkit; This node essentially "subtracts" the contents of List B from List A to produce a new list with the unique items.
generate_selection_filter = Custom[Generate Selection Filter](VARCreateSelectionFilter=n22_create_selection_filter, VARFilterNametoCreate=n23_filter_name_to_create, VAROverwriteExistingFilter=n24_overwrite_existing_filter, VARElements=removeListFromList)  # package Synthesize toolkit; Generate Selection FIlter
eraser = Custom[ST.Tool.Eraser](VARList=k_array_for_groups.VARElementstoErase)  # package Synthesize toolkit; Try to delete any element from project
fix_factor_depends_of_project = DoubleInput(1000)  # "Fix Factor (Depends of Project Units, 1 For meters for example, and 100 for Centimeters)"
debug_python = Custom[Debug Python]()  # package Synthesize toolkit; Debug Python
