# Dynamo graph Groups.Type Randomize By Selection.dyn (Dynamo 2.13.1.3887)
# author: karam@aecedx.com
# packages: Synthesize toolkit 12.5.1

# group: Input
n01_select_groups_to_randomize = DSModelElementsSelection()  # "01.Select Groups to Randomize"; nothing selected; graph input
n02_randomize_all_groups_false = BoolSelector(true)  # "02.Randomize All Groups ? (False for Specific Group Names)"; graph input
n03_specific_group_names_separate = StringInput("Group 1, Group 2")  # "03.Specific Group Names (Separate by Comma , )"; graph input

code_block = CodeBlock { "Group"; }
filterByString = Custom[ST.List.FilterByString](VARlist=n01_select_groups_to_randomize, VARString=code_block)  # package Synthesize toolkit; Filter a list by a string match
code_block_2 = CodeBlock { "Type"; }
element_types = ElementTypes("GroupType")
all_elements_of_type = ElementsOfType(element_type=element_types)
code_block_3 = CodeBlock { ","; }
split = String.Split(string=n03_specific_group_names_separate, separator0=code_block_3)
trimWhitespace = String.TrimWhitespace(string=split)
count = List.Count(list=trimWhitespace)
ofRepeatedItem = List.OfRepeatedItem(item=all_elements_of_type, amount=count)
code_block_4 = CodeBlock { "Type Name"; }
getParameterValueByName = Element.GetParameterValueByName(element=all_elements_of_type, parameterName=code_block_4)
eq = getParameterValueByName == trimWhitespace@L1
filterByBoolMask = List.FilterByBoolMask(list=ofRepeatedItem, mask=eq)
code_block_5 = CodeBlock { false; }
clean = List.Clean(list=filterByBoolMask.in, preserveIndices=code_block_5)
scopeIf = Custom[CW.ScopeIf+](VARtest=n02_randomize_all_groups_false, VARtrue=all_elements_of_type, VARfalse=clean)  # package Synthesize toolkit; A (hopefully) more robust implementation of ScopeIf. Tests a single boolean and returns a value accordingly.
flatten = List.Flatten(list=scopeIf)
count_2 = List.Count(list=filterByString.VARMatch)
cycle = List.Cycle(list=flatten, amount=count_2)
shuffle = List.Shuffle(list=cycle)
count_3 = List.Count(list=flatten)
chop = List.Chop(list=shuffle, lengths=count_3)
firstItem = List.FirstItem(list=chop@L2)
setParameterByName = Element.SetParameterByName(element=filterByString.VARMatch, parameterName=code_block_2, value=firstItem)
debug_python = Custom[Debug Python]()  # package Synthesize toolkit; Debug Python
