# Dynamo graph Join.K-Join All In One.dyn (Dynamo 2.13.1.3887)
# author: karam@aecedx.com
# packages: Synthesize toolkit 12.5.1

# group: Input
n09_scan_ceilings = BoolSelector(true)  # "09.Scan Ceilings"; graph input
n10_scan_columns = BoolSelector(true)  # "10.Scan Columns"; graph input
n11_scan_floors = BoolSelector(true)  # "11.Scan Floors"; graph input
n12_scan_floors_slab_edges = BoolSelector(true)  # "12.Scan Floors - Slab Edges"; graph input
n13_scan_generic_models = BoolSelector(true)  # "13.Scan Generic Models"; graph input
n14_scan_mass = BoolSelector(false)  # "14.Scan Mass"; graph input
n15_scan_roofs = BoolSelector(true)  # "15.Scan Roofs"; graph input
n16_scan_roofs_fascias = BoolSelector(true)  # "16.Scan Roofs - Fascias"; graph input
n17_scan_roofs_gutters = BoolSelector(true)  # "17.Scan Roofs - Gutters"; graph input
n18_scan_roofs_roof_soffits = BoolSelector(true)  # "18.Scan Roofs - Roof Soffits"; graph input
n19_scan_structural_columns = BoolSelector(true)  # "19.Scan Structural Columns"; graph input
n20_scan_structural_foundations = BoolSelector(true)  # "20.Scan Structural Foundations"; graph input
n21_scan_structural_framing = BoolSelector(true)  # "21.Scan Structural Framing"; graph input
n22_scan_walls = BoolSelector(true)  # "22.Scan Walls"; graph input
n23_scan_walls_wall_sweeps = BoolSelector(true)  # "23.Scan Walls - Wall Sweeps"; graph input
n01_detection_mode_1_visible = IntegerSlider(1, range=1..3 step 1)  # "01.Detection Mode: 1 = Visible Elements Only | 2 = Visible Elements With All Project | 3 = All Project"; graph input
n03_include_walls_with_walls_not = BoolSelector(false)  # "03.Include Walls With Walls (Not Recommended)"; graph input
n06_switch_join_order_of_already = BoolSelector(false)  # "06.Switch Join Order of Already Joined Elements ?"; graph input
n04_consider_volumetric_rule_for = BoolSelector(true)  # "04.Consider Volumetric Rule For Joining ? (Materials Must Be Assigned)"; graph input
n07_start_joining_new_elements = BoolSelector(true)  # "07.Start Joining New Elements ?"; graph input
n08_switch_join_order_for_newely = BoolSelector(false)  # "08.Switch Join Order For Newely Joined Elements ?"; graph input
n05_clean_up_all_the_joining = BoolSelector(true)  # "05.Clean Up All The Joining Warnings ?"; graph input
n24_scan_stairs = BoolSelector(true)  # "24.Scan Stairs"; graph input
n25_scan_stairs_supports = BoolSelector(true)  # "25.Scan Stairs Supports"; graph input
n02_avoid_warnings_faulty = BoolSelector(false)  # "02.Avoid Warnings (Faulty Elements Won't Join)"; graph input

k_join_all_in_one = Custom[K-Join All In One](VARCeilings=n09_scan_ceilings, VARColumns=n10_scan_columns, VARFloors=n11_scan_floors, VARFloorsSlabEdges=n12_scan_floors_slab_edges, VARGenericModels=n13_scan_generic_models, VARMass=n14_scan_mass, VARRoofs=n15_scan_roofs, VARRoofsFascias=n16_scan_roofs_fascias, VARRoofsGutters=n17_scan_roofs_gutters, VARRoofSoffits=n18_scan_roofs_roof_soffits, VARStructuralColumns=n19_scan_structural_columns, VARStructuralFoundations=n20_scan_structural_foundations, VARStructuralFraming=n21_scan_structural_framing, VARWalls=n22_scan_walls, VARWallSweeps=n23_scan_walls_wall_sweeps, VARDetectionMode=n01_detection_mode_1_visible, VARIncludeWallsWithWalls=n03_include_walls_with_walls_not, VARSwitchJoinOrderofAlreadyJoinedElements=n06_switch_join_order_of_already, VARConsiderVolumetricRuleForJoining=n04_consider_volumetric_rule_for, VARStartJoiningNewElements=n07_start_joining_new_elements, VARSwitchJoinOrderForNewelyJoinedElements=n08_switch_join_order_for_newely, VARCleanUpAllTheJoiningWarnings=n05_clean_up_all_the_joining, VARStairs=n24_scan_stairs, VARStairsSupports=n25_scan_stairs_supports, VARAvoidWarnings=n02_avoid_warnings_faulty)  # package Synthesize toolkit; K-Join All In One
debug_python_no_message = Custom[Debug Python No Message]()  # package Synthesize toolkit; Debug Python
