# Dynamo graph Join.K-Join Interference Check.dyn (Dynamo 2.13.1.3887)
# author: karam@aecedx.com
# packages: Synthesize toolkit 12.5.1

# group: Input
n07_switch_join_order_of_already = BoolSelector(false)  # "07.Switch Join Order of Already Joined Elements ?"; graph input
n05_consider_volumetric_rule_for = BoolSelector(true)  # "05.Consider Volumetric Rule For Joining ? (Materials Must Be Assigned)"; graph input
n08_start_joining_new_elements = BoolSelector(true)  # "08.Start Joining New Elements ?"; graph input
n09_switch_join_order_for_newely = BoolSelector(false)  # "09.Switch Join Order For Newely Joined Elements ?"; graph input
n06_clean_up_all_the_joining = BoolSelector(true)  # "06.Clean Up All The Joining Warnings ?"; graph input
n01_interference_check_report = Filename("No file selected.")  # "01.Interference Check Report (.html)"; graph input
n04_cut_command_instead = BoolSelector(false)  # "04.Cut Command Instead ?"; graph input
n03_unjoin_mode = BoolSelector(false)  # "03.Unjoin Mode ?"; graph input
n02_avoid_warnings_faulty = BoolSelector(false)  # "02.Avoid Warnings (Faulty Elements Won't Join)"; graph input

k_join_all_in_one_by = Custom[K-Join All In One By Interference Check File](VARSwitchJoinOrderofAlreadyJoinedElements=n07_switch_join_order_of_already, VARConsiderVolumetricRuleForJoining=n05_consider_volumetric_rule_for, VARStartJoiningNewElements=n08_start_joining_new_elements, VARSwitchJoinOrderForNewelyJoinedElements=n09_switch_join_order_for_newely, VARCleanUpAllTheJoiningWarnings=n06_clean_up_all_the_joining, VARInterferenceCheckReport=n01_interference_check_report, VARCutMode=n04_cut_command_instead, VARUnjoinMode=n03_unjoin_mode, VARAvoidWarnings=n02_avoid_warnings_faulty)  # package Synthesize toolkit; K-Join All In One
debug_python_no_message = Custom[Debug Python No Message]()  # package Synthesize toolkit; Debug Python
