# Dynamo graph Join.K-Join Two Categories.dyn (Dynamo 2.13.1.3887)
# author: karam@aecedx.com
# packages: Synthesize toolkit 12.5.1

# group: Input
n10_switch_join_order_of_already = BoolSelector(false)  # "10.Switch Join Order of Already Joined Elements ?"; graph input
n08_consider_volumetric_rule_for = BoolSelector(true)  # "08.Consider Volumetric Rule For Joining ? (Materials Must Be Assigned)"; graph input
n11_start_joining_new_elements = BoolSelector(true)  # "11.Start Joining New Elements ?"; graph input
n12_switch_join_order_for_newely = BoolSelector(false)  # "12.Switch Join Order For Newely Joined Elements ?"; graph input
n09_clean_up_all_the_joining = BoolSelector(false)  # "09.Clean Up All The Joining Warnings ?"; graph input
n07_cut_command_instead = BoolSelector(false)  # "07.Cut Command Instead ?"; graph input
n06_unjoin_mode = BoolSelector(false)  # "06.Unjoin Mode ?"; graph input
n05_avoid_warnings_faulty = BoolSelector(false)  # "05.Avoid Warnings (Faulty Elements Won't Join)"; graph input
n04_include_walls_with_walls_not = BoolSelector(false)  # "04.Include Walls With Walls (Not Recommended)"; graph input
n03_visible_elements_only = BoolSelector(false)  # "03.Visible Elements Only ?"; graph input
n01_category_1 = Categories()  # "01.Category 1"; nothing selected; graph input
n02_category_2 = Categories()  # "02.Category 2"; nothing selected; graph input

k_join_two_categories = Custom[K-Join Two Categories](VARSwitchJoinOrderofAlreadyJoinedElements=n10_switch_join_order_of_already, VARConsiderVolumetricRuleForJoining=n08_consider_volumetric_rule_for, VARStartJoiningNewElements=n11_start_joining_new_elements, VARSwitchJoinOrderForNewelyJoinedElements=n12_switch_join_order_for_newely, VARCleanUpAllTheJoiningWarnings=n09_clean_up_all_the_joining, VARCutMode=n07_cut_command_instead, VARUnjoinMode=n06_unjoin_mode, VARAvoidWarnings=n05_avoid_warnings_faulty, VARIncludeWallsWithWalls=n04_include_walls_with_walls_not, VARActiveViewOnly=n03_visible_elements_only, VARCategory1=n01_category_1, VARCategory2=n02_category_2)  # package Synthesize toolkit; K-Join Two Categories
debug_python_no_message = Custom[Debug Python No Message]()  # package Synthesize toolkit; Debug Python
