# Dynamo graph Join.Single Element With Surroundings.dyn (Dynamo 2.13.1.3887)
# author: karam@aecedx.com
# packages: Synthesize toolkit 12.5.1

# group: Input
n01_select_element = DSModelElementSelection()  # "01.Select Element"; nothing selected; graph input
n04_consider_volumetric_rule_for = BoolSelector(true)  # "04.Consider Volumetric Rule For Joining ? (Materials Must Be Assigned)"; graph input
n05_switch_join_order_of_already = BoolSelector(false)  # "05.Switch Join Order of Already Joined Elements ?"; graph input
n03_temporarily_isolate_possible = BoolSelector(false)  # "03.Temporarily Isolate Possible To Join Elements ?"; graph input
n06_start_joining_new_elements = BoolSelector(true)  # "06.Start Joining New Elements ?"; graph input
n07_switch_join_order_for_newely = BoolSelector(false)  # "07.Switch Join Order For Newely Joined Elements ?"; graph input
n02_include_walls_with_walls = BoolSelector(false)  # "02.Include Walls With Walls ?"; graph input

join_single_element_with = Custom[Join Single Element With Surroundings](VARElement=n01_select_element, VARConsiderVolumetricRuleForJoiningMaterialsMustBeAssigned=n04_consider_volumetric_rule_for, VARSwitchJoinOrderofAlreadyJoinedElements=n05_switch_join_order_of_already, VARTemporarilyIsolatePossibleToJoinElements=n03_temporarily_isolate_possible, VARStartJoiningNewElements=n06_start_joining_new_elements, VARSwitchJoinOrderForNewelyJoinedElements=n07_switch_join_order_for_newely, VARIncludeWallsWithWalls=n02_include_walls_with_walls)  # package Synthesize toolkit; Join Single Element With Surroundings

# group: Report
n01_the_following_elements_don_t = Watch(join_single_element_with)  # "01.The Following Elements Don't Have Materials"; graph output

debug_python_no_message = Custom[Debug Python No Message]()  # package Synthesize toolkit; Debug Python
