# Dynamo graph Join.Unjoin All Elements of Category.dyn (Dynamo 2.13.1.3887)
# author: karam@aecedx.com
# packages: Synthesize toolkit 12.5.1

# group: Input
n01_category_to_unjoin = Categories("OST_Floors")  # "01.Category to Unjoin"; graph input
n03_unjoin_visible_elements_in = BoolSelector(false)  # "03.Unjoin Visible Elements in Active View Only ?"; graph input
n02_category_to_unjoin_from = Categories("OST_Walls")  # "02.Category to Unjoin From"; graph input

all_elements_of_category = ElementsOfCategory(Category=n01_category_to_unjoin)
all_elements_of_category_2 = ElementsOfCategory(Category=n02_category_to_unjoin_from)
python_all_elements_in_active = Custom[Python All Elements In Active View]()  # package Synthesize toolkit; Python All Elements In Active View
unjoin_elements_smart = Custom[Unjoin Elements (Smart)](VARListtoUnjoin=all_elements_of_category, VARUnjoinVisibleElementsinActiveViewOnly=n03_unjoin_visible_elements_in, VARListtoUnjoinFrom=all_elements_of_category_2, VARAllElementsinActiveView=python_all_elements_in_active)  # package Synthesize toolkit; Unjoin Elements (Smart)
debug_python_no_message = Custom[Debug Python No Message]()  # package Synthesize toolkit; Debug Python
