# Dynamo graph Join.Unjoin Selection Filter.dyn (Dynamo 2.13.1.3887)
# author: karam@aecedx.com
# packages: Synthesize toolkit 12.5.1

hot_get_all_filter = Custom[HOT.Get All Filter]()  # package Synthesize toolkit; Get all Filter
toLower = String.ToLower(string=hot_get_all_filter.VARName)
trimWhitespace = String.TrimWhitespace(string=toLower)

# group: Input
n01_selection_filter_to_read_to = StringInput("Selection Filter")  # "01.Selection Filter to Read To Ujoin"; graph input
n03_unjoin_visible_elements_in = BoolSelector(false)  # "03.Unjoin Visible Elements in Active View Only ?"; graph input
n02_selection_filter_to_read_to = StringInput("Selection Filter")  # "02.Selection Filter to Read To Ujoin From"; graph input

toLower_2 = String.ToLower(string=n01_selection_filter_to_read_to)
trimWhitespace_2 = String.TrimWhitespace(string=toLower_2)
eq = trimWhitespace == trimWhitespace_2
filterByBoolMask = List.FilterByBoolMask(list=hot_get_all_filter.VARElement, mask=eq)
elements = Custom[CW.SelectionSet.Elements](VARselectionSet=filterByBoolMask.in)  # package Synthesize toolkit; Retrieves all elements stored in a selection set
hot_get_all_filter_2 = Custom[HOT.Get All Filter]()
toLower_3 = String.ToLower(string=hot_get_all_filter_2.VARName)
trimWhitespace_3 = String.TrimWhitespace(string=toLower_3)
toLower_4 = String.ToLower(string=n02_selection_filter_to_read_to)
trimWhitespace_4 = String.TrimWhitespace(string=toLower_4)
eq_2 = trimWhitespace_3 == trimWhitespace_4
filterByBoolMask_2 = List.FilterByBoolMask(list=hot_get_all_filter_2.VARElement, mask=eq_2)
elements_2 = Custom[CW.SelectionSet.Elements](VARselectionSet=filterByBoolMask_2.in)
python_all_elements_in_active = Custom[Python All Elements In Active View]()  # package Synthesize toolkit; Python All Elements In Active View
unjoin_elements_smart = Custom[Unjoin Elements (Smart)](VARListtoUnjoin=elements, VARUnjoinVisibleElementsinActiveViewOnly=n03_unjoin_visible_elements_in, VARListtoUnjoinFrom=elements_2, VARAllElementsinActiveView=python_all_elements_in_active)  # package Synthesize toolkit; Unjoin Elements (Smart)
debug_python_no_message = Custom[Debug Python No Message]()  # package Synthesize toolkit; Debug Python
