# Dynamo graph Join.Unjoin Warnings.dyn (Dynamo 2.13.1.3887)
# author: karam@aecedx.com
# packages: Synthesize toolkit 12.5.1

code_block = CodeBlock { true; }
getWarnings = Custom[ZK.Document.GetWarnings](VARRefresh=code_block)  # package Synthesize toolkit; NOTE: Works only with Revit 2018 and above! Get all warnings from the current document.
code_block_2 = CodeBlock { "Highlighted elements are joined but do not intersect."; }
eq = getWarnings.WarningText == code_block_2
filterByBoolMask = List.FilterByBoolMask(list=getWarnings.FailingElementIds, mask=eq)
al_current_document = Custom[AL.Current Document]()  # package Synthesize toolkit; Retrieves Current Document
al_id_to_element = Custom[AL.Id to Element](VARIds=filterByBoolMask.in, VARDoc=al_current_document)  # package Synthesize toolkit; Selects elements in a model from id input (ElementId, string, integer or GUID)
python_script = Python(IN[0]=al_id_to_element)  # IronPython2
# ---------- python_script.python (34 lines) ----------
import clr
clr.AddReference('ProtoGeometry')
from Autodesk.DesignScript.Geometry import *

clr.AddReference("RevitAPI")
import Autodesk
from Autodesk.Revit.DB import *

clr.AddReference("RevitServices")
import RevitServices
from RevitServices.Persistence import DocumentManager
from RevitServices.Transactions import TransactionManager
from System.Collections.Generic import *

clr.AddReference("RevitNodes")
import Revit
clr.ImportExtensions(Revit.Elements)

doc = DocumentManager.Instance.CurrentDBDocument
TransactionManager.Instance.EnsureInTransaction(doc)

elements = UnwrapElement(IN[0])
count = 0
result = []
while (count < len(elements)):
	try:
		Autodesk.Revit.DB.JoinGeometryUtils.UnjoinGeometry(doc, elements[count][0], elements[count][1])
		count = count + 1
		result.append("Success")
	except:
		count = count +1

TransactionManager.Instance.TransactionTaskDone()
OUT = result
# ----------------------------------------
debug_python_no_message = Custom[Debug Python No Message]()  # package Synthesize toolkit; Debug Python
