# Dynamo graph Levels.Auto Create.dyn (Dynamo 2.13.1.3887)
# author: karam@aecedx.com
# packages: Synthesize toolkit 12.5.1

# group: Input
n01_select_starting_level = DSModelElementSelection()  # "01.Select Starting Level"; nothing selected; graph input
n10_reverse_creation_naming = BoolSelector(false)  # "10.Reverse Creation & Naming"; graph input
n04_distance_between_levels = DoubleInput(4)  # "04.Distance Between Levels ?"; graph input
n03_number_of_levels_wanted = DoubleInput(10)  # "03.Number of Levels Wanted ?"; graph input
n05_prefix_to_add_can_be_empty = StringInput("Level ")  # "05.Prefix to Add (Can be Empty) ?"; graph input
n06_number_sequence_start = DoubleInput(3)  # "06.Number Sequence Start"; graph input
n09_remove_0_s_ignores_no_of = BoolSelector(false)  # "09.Remove 0's (Ignores No of Digits)"; graph input
n08_no_of_digits = DoubleSlider(2, range=1..3 step 1)  # "08.No.of Digits"; graph input
n07_suffix_to_add_can_be_empty = StringInput("")  # "07.Suffix to Add (Can be Empty) ?"; graph input
parameter_to_work_on = StringInput("Name")
n02_detect_scope_box_of_starting = BoolSelector(false)  # "02.Detect Scope Box of Starting Level ?"; graph input

code_block = CodeBlock(a=n04_distance_between_levels) { a*-1; }
scopeIf = Custom[CW.ScopeIf+](VARtest=n10_reverse_creation_naming, VARtrue=code_block, VARfalse=n04_distance_between_levels)  # package Synthesize toolkit; A (hopefully) more robust implementation of ScopeIf. Tests a single boolean and returns a value accordingly.
sequence = Sequence(start=scopeIf, amount=n03_number_of_levels_wanted, step=scopeIf, lacing=Longest)
random = Math.Random(seed=sequence)
string_from_object = FromObject(obj=random)
byLevelOffsetAndName = Level.ByLevelOffsetAndName(level=n01_select_starting_level, offset=sequence, name=string_from_object)
count = List.Count(list=byLevelOffsetAndName)
code_block_2 = CodeBlock { false; }
sequenced_string_numbers = Custom[Sequenced String Numbers Generate](VARCountofElements=count, VARPrefixtoAddCanbeEmpty=n05_prefix_to_add_can_be_empty, VARNumberSequenceStart=n06_number_sequence_start, VARRemove0s=n09_remove_0_s_ignores_no_of, VAR=n08_no_of_digits, VARSuffixtoAddCanbeEmpty=n07_suffix_to_add_can_be_empty, VARReverseNaming=code_block_2)  # package Synthesize toolkit; Sequenced String Numbers Generate

# group: Report
report = Watch(sequenced_string_numbers.VARReport)  # "01.Report"; graph output

code_block_3 = CodeBlock { "Duplicated names found, Please Increase No.of Digits or Activate Remove 0's"; }
eq = report == code_block_3
empty = List.Empty()
scopeIf_2 = Custom[CW.ScopeIf+](VARtest=eq, VARtrue=byLevelOffsetAndName, VARfalse=empty)
eraser = Custom[ST.Tool.Eraser](VARList=scopeIf_2)  # package Synthesize toolkit; Try to delete any element from project
setParameterByName = Element.SetParameterByName(element=byLevelOffsetAndName, parameterName=parameter_to_work_on, value=sequenced_string_numbers.VARValues)
code_block_4 = CodeBlock { "Scope Box"; }
empty_2 = List.Empty()
scopeIf_3 = Custom[CW.ScopeIf+](VARtest=n02_detect_scope_box_of_starting, VARtrue=n01_select_starting_level, VARfalse=empty_2)
parameterExists = Custom[CW.Element.ParameterExists](VARparam=code_block_4, VARelement=scopeIf_3)  # package Synthesize toolkit; Checks if an element contains a parameter of a given name
filterByBoolMask = List.FilterByBoolMask(list=scopeIf_3, mask=parameterExists)
getParameterValueByName = Element.GetParameterValueByName(element=filterByBoolMask.in, parameterName=code_block_4)
setParameterByName_2 = Element.SetParameterByName(element=setParameterByName, parameterName=code_block_4, value=getParameterValueByName, lacing=Longest)
debug_python_no_message = Custom[Debug Python No Message]()  # package Synthesize toolkit; Debug Python
