# Dynamo graph Levels.Auto Sequence.dyn (Dynamo 2.13.1.3887)
# author: karam@aecedx.com
# packages: Synthesize toolkit 12.5.1

# group: Input
n05_proceed = BoolSelector(false)  # "05.Proceed ?"; graph input
n01_select_levels = DSModelElementsSelection()  # "01.Select Levels"; nothing selected; graph input
n02_start_elevation = DoubleInput(0)  # "02.Start Elevation"; graph input
n04_reverse_levels = BoolSelector(false)  # "04.Reverse Levels ?"; graph input
n03_space_between_each = DoubleInput(4)  # "03.Space Between Each"; graph input

code_block = CodeBlock { "Level"; }
byClassName = Custom[SP.Filter.ByClassName](VARobject=n01_select_levels, VARclassName=code_block)  # package Synthesize toolkit; Filters a list of objects by the object's class name. Note that Dynamo elements belong to different classes than their Revit counterparts. Use the Object.Class node to check an object's class.
code_block_2 = CodeBlock { null; false; }
scopeIf = Custom[CW.ScopeIf+](VARtest=n05_proceed, VARtrue=byClassName.VARin, VARfalse=code_block_2.out0)  # package Synthesize toolkit; A (hopefully) more robust implementation of ScopeIf. Tests a single boolean and returns a value accordingly.
clean = List.Clean(list=scopeIf, preserveIndices=code_block_2.out1)
code_block_3 = CodeBlock { "Elevation"; }
scopeIf_2 = Custom[CW.ScopeIf+](VARtest=n05_proceed, VARtrue=code_block_3, VARfalse=code_block_2.out0)
clean_2 = List.Clean(list=scopeIf_2, preserveIndices=code_block_2.out1)
count = List.Count(list=byClassName.VARin)
code_block_4 = CodeBlock { -1; }
mul = n03_space_between_each * code_block_4
scopeIf_3 = Custom[CW.ScopeIf+](VARtest=n04_reverse_levels, VARtrue=mul, VARfalse=n03_space_between_each)
sequence = Sequence(start=n02_start_elevation, amount=count, step=scopeIf_3, lacing=Longest)
scopeIf_4 = Custom[CW.ScopeIf+](VARtest=n05_proceed, VARtrue=sequence, VARfalse=code_block_2.out0)
clean_3 = List.Clean(list=scopeIf_4, preserveIndices=code_block_2.out1)
setParameterByName = Element.SetParameterByName(element=clean, parameterName=clean_2, value=clean_3, lacing=Longest)
count_2 = List.Count(list=byClassName.VARin)

# group: Report
n01_number_of_selected_levels = Watch(count_2)  # "01.Number of Selected Levels"; graph output
n02_values_of_elevations = Watch(sequence)  # "02.Values of Elevations"; graph output

debug_python_no_message = Custom[Debug Python No Message]()  # package Synthesize toolkit; Debug Python
