# Dynamo graph Levels.Transfer Between Documents.dyn (Dynamo 2.13.1.3887)
# author: karam@aecedx.com
# packages: Synthesize toolkit 12.5.1

# group: Input
n01_from_document_number = DoubleInput(0)  # "01.From Document (Number)"; graph input
n02_to_document_number = DoubleInput(1)  # "02.To Document (Number)"; graph input
proceed = BoolSelector(false)  # "03.Proceed"; graph input

python_script = Python(IN[0]=n01_from_document_number, IN[1]=n02_to_document_number, IN[2]=proceed)  # IronPython2
# ---------- python_script.python (89 lines) ----------
# Enable Python support and load DesignScript library
# IMPORTANT : ALL DYNAMO DESIGN SCRIPT NODES ARE AS (dg)
import clr
clr.AddReference('ProtoGeometry')
from Autodesk.DesignScript import Geometry as dg

# EXTENSION Enable ToDSType
clr.AddReference('RevitNodes')
import Revit

# Enable Revit API
clr.AddReference('RevitAPI')
from Autodesk.Revit.DB import *

# Enable DocumentManager and TransactionManager
clr.AddReference('RevitServices')
from RevitServices.Persistence import DocumentManager
from RevitServices.Transactions import TransactionManager

class WarnSwallowSimple(IFailuresPreprocessor):
	def PreprocessFailures(self, failuresAccessor):
		failuresAccessor.DeleteAllWarnings()
		return FailureProcessingResult.Continue

# Choose The Current Document
doc = DocumentManager.Instance.CurrentDBDocument
uidoc = DocumentManager.Instance.CurrentUIApplication.ActiveUIDocument
uiapp = DocumentManager.Instance.CurrentUIApplication
app = uiapp.Application

from_doc = int(IN[0])
to_doc = int(IN[1])
proceed = IN[2]

alldocs = app.Documents

document_names = []
for eachdoc in alldocs:
	name = eachdoc.Title
	is_family = eachdoc.IsFamilyDocument
	if is_family and name.endswith(".rfa") == False:
		document_names.append(name + ".rfa")
	elif is_family == False and name.endswith(".rvt") == False:
		document_names.append(name + ".rvt")
	else:
		document_names.append(name)

if proceed and from_doc != to_doc:
	from_doc = list(alldocs)[from_doc]
	to_doc = list(alldocs)[to_doc]
	levels = FilteredElementCollector(from_doc).OfCategory(BuiltInCategory.OST_Levels).WhereElementIsNotElementType().ToElements()
	existedlevels = FilteredElementCollector(to_doc).OfCategory(BuiltInCategory.OST_Levels).WhereElementIsNotElementType().ToElements()
	existednames = []
	for existedlevel in existedlevels:
		existednames.append(existedlevel.Name.lower())
	levels_data = []
	for level in levels:
		lvl_name = level.Name
		if existednames.Contains(lvl_name.lower()):
			doesexist = True
			existed_level_element = existedlevels[existednames.IndexOf(lvl_name.lower())]
		else:
			doesexist = False
			existed_level_element = None
		levels_data.append([existed_level_element,lvl_name,level.Elevation,doesexist])
		
	TransactionManager.Instance.ForceCloseTransaction()
	trans1 = Transaction(to_doc, 'Transfer Levels')
	trans1.Start()
	warnhandle = WarnSwallowSimple()
	foptions = trans1.GetFailureHandlingOptions()
	foptions.SetFailuresPreprocessor(warnhandle)
	trans1.SetFailureHandlingOptions(foptions)
	for each_data in levels_data:
		data_level_element = each_data[0]
		data_name = each_data[1]
		data_elevation = each_data[2]
		data_exists = each_data[3]
		if data_exists:
			if data_level_element.Elevation == data_elevation:
				continue
			else:
				data_level_element.Elevation = data_elevation
		else:
			new_level = Level.Create(to_doc,data_elevation)
			new_level.Name = data_name
	trans1.Commit()

OUT = document_names 
# ----------------------------------------
n01_opened_documents_numbers = Watch(python_script)  # "01.Opened Documents (Numbers)"; graph output
debug_python_no_message = Custom[Debug Python No Message]()  # package Synthesize toolkit; Debug Python
