# Dynamo graph Lines.By Custom Offset or Fillet of Selection.dyn (Dynamo 2.13.1.3887)
# author: karam@aecedx.com
# packages: Synthesize toolkit 12.5.1

# group: Input
n02_delete_old = BoolSelector(false)  # "02.Delete Old ?"; graph input
n01_select_cad_file_lines_to = DSModelElementsSelection()  # "01.Select CAD File / Lines to Fillet or Offset"; nothing selected; graph input
n07_detail_lines_false_model = BoolSelector(true)  # "07.Detail Lines = False | Model Lines = True"; graph input
n05_radius_or_chamfer_distance_0 = DoubleInput(0)  # "05.Radius or Chamfer Distance (0 Disables It)"; graph input
n06_offset_distance_0_disables_it = DoubleInput(0)  # "06.Offset Distance (0 Disables It)"; graph input
n04_flip_for_arc_chamfer_mode = BoolSelector(true)  # "04.Flip (For Arc Chamfer Mode)"; graph input
n03_mode_1_fillet_2_arc_chamfer_3 = IntegerSlider(1, range=1..3 step 1)  # "03.Mode : 1 = Fillet | 2 = Arc Chamfer | 3 = Chamfer"; graph input
n08_create_selection_filter = BoolSelector(true)  # "08.Create Selection Filter ?"; graph input
n09_filter_name_to_create = StringInput("Dynamo Offsetted or Filleted Lines")  # "09.Filter Name to Create"; graph input
n10_overwrite_existing_filter = BoolSelector(false)  # "10.Overwrite Existing Filter ? (False for Adding Elements)"; graph input

flatten = List.Flatten(list=n01_select_cad_file_lines_to)
curves = Element.Curves(element=n01_select_cad_file_lines_to)
isEmpty = List.IsEmpty(list=curves, lacing=Longest)
filterByBoolMask = List.FilterByBoolMask(list=flatten, mask=isEmpty)
flatten_2 = List.Flatten(list=curves)
as_polycurve_bycurves = Custom[AS.[&] PolyCurve.ByCurves](VARcurves=flatten_2)  # package Synthesize toolkit; Create polycurves from an unordered list of curves.
generate_offset_or_fillet_lines = Custom[Generate Offset or Fillet Lines](VARDetailLines=n07_detail_lines_false_model, VARRadiusorChamfer=n05_radius_or_chamfer_distance_0, VAROffsetDistance=n06_offset_distance_0_disables_it, VARPolyCurves=as_polycurve_bycurves.VARpolyCurve, VARFlipForArcChamferMode=n04_flip_for_arc_chamfer_mode, VAR1Fillet2ArcChamfe3Chamfer=n03_mode_1_fillet_2_arc_chamfer_3)  # package Synthesize toolkit; Generate Offset or Fillet Lines
passthrough = Custom[CW.Passthrough](VARpassThrough=filterByBoolMask.out, VARwaitFor=generate_offset_or_fillet_lines)  # package Synthesize toolkit; Forces a sequential order of execution. The node wired into the output of the Passthrough node will be executed *after* the node wired into the waitFor input (e.g. important for some Revit operations). The value of the passThrough input will be passed on to the node wired into the output port of the Passthrough node.
flatten_3 = List.Flatten(list=passthrough)
code_block = CodeBlock { null; }
scopeIf = Custom[CW.ScopeIf+](VARtest=n02_delete_old, VARtrue=flatten_3, VARfalse=code_block)  # package Synthesize toolkit; A (hopefully) more robust implementation of ScopeIf. Tests a single boolean and returns a value accordingly.
eraser = Custom[ST.Tool.Eraser](VARList=scopeIf)  # package Synthesize toolkit; Try to delete any element from project
generate_selection_filter = Custom[Generate Selection Filter](VARCreateSelectionFilter=n08_create_selection_filter, VARFilterNametoCreate=n09_filter_name_to_create, VAROverwriteExistingFilter=n10_overwrite_existing_filter, VARElements=generate_offset_or_fillet_lines)  # package Synthesize toolkit; Generate Selection FIlter
debug_python = Custom[Debug Python]()  # package Synthesize toolkit; Debug Python
