# Dynamo graph Lines.By Direct Fillet.dyn (Dynamo 2.13.1.3887)
# author: karam@aecedx.com
# packages: Synthesize toolkit 12.5.1

# group: Input
n05_detail_line_false_model_line = BoolSelector(true)  # "05.Detail Line = False | Model Line = True"; graph input
n01_select_line_1 = DSModelElementSelection()  # "01.Select Line 1"; nothing selected; graph input
n02_select_line_2 = DSModelElementSelection()  # "02.Select Line 2"; nothing selected; graph input
n03_toggle_start_end_of_line_1 = BoolSelector(false)  # "03.Toggle Start/End of Line 1"; graph input
n04_toggle_start_end_of_line_2 = BoolSelector(false)  # "04.Toggle Start/End of Line 2"; graph input

curves = Element.Curves(element=n01_select_line_1)
curves_2 = Element.Curves(element=n02_select_line_2)
byBlendBetweenCurves = Curve.ByBlendBetweenCurves(curve1=curves, curve2=curves_2, endOrStart1=n03_toggle_start_end_of_line_1, endOrStart2=n04_toggle_start_end_of_line_2)
flatten = List.Flatten(list=byBlendBetweenCurves)
code_block = CodeBlock { null; false; }
scopeIf = Custom[CW.ScopeIf+](VARtest=n05_detail_line_false_model_line, VARtrue=flatten, VARfalse=code_block.out0)  # package Synthesize toolkit; A (hopefully) more robust implementation of ScopeIf. Tests a single boolean and returns a value accordingly.
clean = List.Clean(list=scopeIf, preserveIndices=code_block.out1)
byCurve = ModelCurve.ByCurve(curve=clean)
scopeIf_2 = Custom[CW.ScopeIf+](VARtest=n05_detail_line_false_model_line, VARtrue=code_block.out0, VARfalse=flatten)
clean_2 = List.Clean(list=scopeIf_2, preserveIndices=code_block.out1)
hot_get_revit_activeview = Custom[HOT.Get Revit ActiveView]()  # package Synthesize toolkit; Active View
fromCurve = Custom[CW.DetailLine.FromCurve](VARcurve=clean_2, VARview=hot_get_revit_activeview)  # package Synthesize toolkit; Creates a detail line based on a given curve
debug_python = Custom[Debug Python]()  # package Synthesize toolkit; Debug Python
