# Dynamo graph Lines.By Extend.dyn (Dynamo 2.13.1.3887)
# author: karam@aecedx.com
# packages: Synthesize toolkit 12.5.1

# group: Input
n02_delete_original = BoolSelector(false)  # "02.Delete Original ?"; graph input
n01_select_curves = DSModelElementsSelection()  # "01.Select Curves"; nothing selected; graph input
n04_number_of_control_points = DoubleInput(10)  # "04.Number of Control Points"; graph input
n03_extend_distance = DoubleInput(5)  # "03.Extend Distance"; graph input

flatten = List.Flatten(list=n01_select_curves)
curves = Element.Curves(element=n01_select_curves)
isEmpty = List.IsEmpty(list=curves, lacing=Longest)
filterByBoolMask = List.FilterByBoolMask(list=flatten, mask=isEmpty)
flatten_2 = List.Flatten(list=curves)
as_polycurve_bycurves = Custom[AS.[&] PolyCurve.ByCurves](VARcurves=flatten_2)  # package Synthesize toolkit; Create polycurves from an unordered list of curves.
flatten_3 = List.Flatten(list=as_polycurve_bycurves.VARpolyCurve)
code_block = CodeBlock { 1; 0; }
sequence = Sequence(start=code_block.out0, amount=n04_number_of_control_points, step=code_block.out0, lacing=Longest)
remapRange = Math.RemapRange(numbers=sequence, newMin=code_block.out1, newMax=code_block.out0)
pointAtParameter = Curve.PointAtParameter(curve=flatten_3@L1, param=remapRange)
pruneDuplicates = Point.PruneDuplicates(points=pointAtParameter)
byPoints = NurbsCurve.ByPoints(points=pruneDuplicates)
extendStart = Curve.ExtendStart(curve=byPoints, distance=n03_extend_distance)
extendEnd = Curve.ExtendEnd(curve=extendStart, distance=n03_extend_distance)
code_block_2 = CodeBlock { null; false; }
clean = List.Clean(list=extendEnd, preserveIndices=code_block_2.out1)
flatten_4 = List.Flatten(list=clean)
pointAtParameter_2 = Curve.PointAtParameter(curve=flatten_4@L1, param=remapRange)
pruneDuplicates_2 = Point.PruneDuplicates(points=pointAtParameter_2)
byPoints_2 = NurbsCurve.ByPoints(points=pruneDuplicates_2)
byCurve = ModelCurve.ByCurve()  # unwired: curve
map = List.Map(list=extendEnd, f_x=byCurve)
isNull = Object.IsNull(object=map)
filterByBoolMask_2 = List.FilterByBoolMask(list=byPoints_2, mask=isNull)
code_block_3 = CodeBlock { false; }
clean_2 = List.Clean(list=filterByBoolMask_2.in, preserveIndices=code_block_3)
flatten_5 = List.Flatten(list=clean_2)
byCurve_2 = ModelCurve.ByCurve(curve=flatten_5)
code_block_4 = CodeBlock { false; }
clean_3 = List.Clean(list=byCurve_2, preserveIndices=code_block_4)
flatten_6 = List.Flatten(list=clean_3)
passthrough = Custom[CW.Passthrough](VARpassThrough=filterByBoolMask.out, VARwaitFor=flatten_6)  # package Synthesize toolkit; Forces a sequential order of execution. The node wired into the output of the Passthrough node will be executed *after* the node wired into the waitFor input (e.g. important for some Revit operations). The value of the passThrough input will be passed on to the node wired into the output port of the Passthrough node.
code_block_5 = CodeBlock { null; }
scopeIf = Custom[CW.ScopeIf+](VARtest=n02_delete_original, VARtrue=passthrough, VARfalse=code_block_5)  # package Synthesize toolkit; A (hopefully) more robust implementation of ScopeIf. Tests a single boolean and returns a value accordingly.
clean_4 = List.Clean(list=scopeIf, preserveIndices=code_block_4)
eraser = Custom[ST.Tool.Eraser](VARList=clean_4)  # package Synthesize toolkit; Try to delete any element from project
debug_python = Custom[Debug Python]()  # package Synthesize toolkit; Debug Python
