# Dynamo graph Lines.By Extract From Rooms.dyn (Dynamo 2.13.1.3887)
# author: karam@aecedx.com
# packages: Synthesize toolkit 12.5.1

# group: Input
n03_create_selection_filter = BoolSelector(true)  # "03.Create Selection Filter ?"; graph input
n04_filter_name_to_create = StringInput("Dynamo Clean Room Lines")  # "04.Filter Name to Create"; graph input
n05_overwrite_existing_filter = BoolSelector(false)  # "05.Overwrite Existing Filter ?"; graph input
n02_simplify_lines = BoolSelector(true)  # "02.Simplify Lines ?"; graph input
n01_select_rooms = DSModelElementsSelection()  # "01.Select Rooms"; nothing selected; graph input

code_block = CodeBlock { "Room"; }
byClassName = Custom[SP.Filter.ByClassName](VARobject=n01_select_rooms, VARclassName=code_block)  # package Synthesize toolkit; Filters a list of objects by the object's class name. Note that Dynamo elements belong to different classes than their Revit counterparts. Use the Object.Class node to check an object's class.
geometry = Element.Geometry(element=byClassName.VARin)
flatten = List.Flatten(list=geometry)
explode = Geometry.Explode(geometry=flatten)
filterByOrientation = Custom[CW.Surface.FilterByOrientation](VARsurfaces=explode)  # package Synthesize toolkit; Sorts surfaces in three lists based on their orientation (vertical, horizontal up & horizontal down) and also returns three corresponding lists of booleans.
flatten_2 = List.Flatten(list=filterByOrientation.VARhorizontalDown)
code_block_2 = CodeBlock { false; }
clean = List.Clean(list=flatten_2, preserveIndices=code_block_2)
perimeterCurves = Surface.PerimeterCurves(surface=clean)
as_polycurve_bycurves = Custom[AS.[&] PolyCurve.ByCurves](VARcurves=perimeterCurves@L2)  # package Synthesize toolkit; Create polycurves from an unordered list of curves.
flatten_3 = List.Flatten(list=as_polycurve_bycurves.VARpolyCurve)
curves = PolyCurve.Curves(polyCurve=flatten_3)
code_block_3 = CodeBlock { null; }
scopeIf = Custom[CW.ScopeIf+](VARtest=n02_simplify_lines, VARtrue=curves, VARfalse=code_block_3)  # package Synthesize toolkit; A (hopefully) more robust implementation of ScopeIf. Tests a single boolean and returns a value accordingly.
simplify = Custom[SP.CurveLoop.Simplify](VARcurveLoop=scopeIf@L2)  # package Synthesize toolkit; Attempts to simplify an open or a closed curve loop by connecting straight separate line segments into a single line.
scopeIf_2 = Custom[CW.ScopeIf+](VARtest=n02_simplify_lines, VARtrue=code_block_3, VARfalse=perimeterCurves)
create = List.Create(item0=simplify, item1=scopeIf_2)
code_block_4 = CodeBlock { false; }
clean_2 = List.Clean(list=create, preserveIndices=code_block_4)
flatten_4 = List.Flatten(list=clean_2)
byCurve = ModelCurve.ByCurve(curve=flatten_4)
generate_selection_filter = Custom[Generate Selection Filter](VARCreateSelectionFilter=n03_create_selection_filter, VARFilterNametoCreate=n04_filter_name_to_create, VAROverwriteExistingFilter=n05_overwrite_existing_filter, VARElements=byCurve)  # package Synthesize toolkit; Generate Selection FIlter
debug_python = Custom[Debug Python]()  # package Synthesize toolkit; Debug Python
