# Dynamo graph Lines.By Grabbing Lines of Families.dyn (Dynamo 2.13.1.3887)
# author: karam@aecedx.com
# packages: Synthesize toolkit 12.5.1

# group: Input
n01_select_families_to_grab_their = DSModelElementsSelection()  # "01.Select Families to Grab Their Model Lines"; nothing selected; graph input
n02_is_reference_usefull_in = BoolSelector(false)  # "02.Is Reference ? (Usefull In Conceptual Environment)"; graph input
n03_create_selection_filter = BoolSelector(true)  # "03.Create Selection Filter ?"; graph input
n04_filter_name_to_create = StringInput("Dynamo Generated Model Lines")  # "04.Filter Name to Create"; graph input
n05_overwrite_existing_filter = BoolSelector(false)  # "05.Overwrite Existing Filter ? (False for Adding Elements)"; graph input

curves = Element.Curves(element=n01_select_families_to_grab_their)
flatten = List.Flatten(list=curves)
byCurve = ModelCurve.ByCurve(curve=flatten)
code_block = CodeBlock { "Is Reference Line"; }
current = Document.Current()
isFamilyDocument = Document.IsFamilyDocument(document=current)
code_block_2 = CodeBlock { false; }
scopeIf = Custom[CW.ScopeIf+](VARtest=isFamilyDocument, VARtrue=n02_is_reference_usefull_in, VARfalse=code_block_2)  # package Synthesize toolkit; A (hopefully) more robust implementation of ScopeIf. Tests a single boolean and returns a value accordingly.
code_block_3 = CodeBlock { null; false; }
scopeIf_2 = Custom[CW.ScopeIf+](VARtest=scopeIf, VARtrue=n02_is_reference_usefull_in, VARfalse=code_block_3.out0)
turnIntoList = Custom[CW.TurnIntoList](VARunknownItem=scopeIf_2)  # package Synthesize toolkit; Turns an element (or a nested list) into a flat list
clean = List.Clean(list=turnIntoList, preserveIndices=code_block_3.out1)
flatten_2 = List.Flatten(list=clean)
code_block_4 = CodeBlock { 1; 0; }
scopeIf_3 = Custom[CW.ScopeIf+](VARtest=flatten_2, VARtrue=code_block_4.out0, VARfalse=code_block_4.out1)
setParameterByName = Element.SetParameterByName(element=byCurve, parameterName=code_block, value=scopeIf_3, lacing=Longest)
generate_selection_filter = Custom[Generate Selection Filter](VARCreateSelectionFilter=n03_create_selection_filter, VARFilterNametoCreate=n04_filter_name_to_create, VAROverwriteExistingFilter=n05_overwrite_existing_filter, VARElements=byCurve)  # package Synthesize toolkit; Generate Selection FIlter
debug_python = Custom[Debug Python]()  # package Synthesize toolkit; Debug Python
