# Dynamo graph Lines.By Reference Planes.dyn (Dynamo 2.13.1.3887)
# author: karam@aecedx.com
# packages: Synthesize toolkit 12.5.1

# group: Input
n01_select_reference_planes = DSModelElementsSelection()  # "01.Select Reference Planes"; nothing selected; graph input

code_block = CodeBlock { "ReferencePlane"; }
byClassName = Custom[SP.Filter.ByClassName](VARobject=n01_select_reference_planes, VARclassName=code_block)  # package Synthesize toolkit; Filters a list of objects by the object's class name. Note that Dynamo elements belong to different classes than their Revit counterparts. Use the Object.Class node to check an object's class.
hot_get_revit_activeview = Custom[HOT.Get Revit ActiveView]()  # package Synthesize toolkit; Active View
getCurvesInView = Custom[RH.ReferencePlane.GetCurvesInView](VARreferencePlane=byClassName.VARin, VARview=hot_get_revit_activeview)  # package Synthesize toolkit; This will obtain the geometric curves of the reference plane in a given view. Revit 2016+
code_block_2 = CodeBlock { false; }
clean = List.Clean(list=getCurvesInView, preserveIndices=code_block_2)
flatten = List.Flatten(list=clean)
fromCurve = Custom[CW.DetailLine.FromCurve](VARcurve=flatten, VARview=hot_get_revit_activeview)  # package Synthesize toolkit; Creates a detail line based on a given curve
count = List.Count(list=fromCurve)

# group: Report
n01_number_of_lines_created = Watch(count)  # "01.Number of Lines Created"; graph output

debug_python = Custom[Debug Python]()  # package Synthesize toolkit; Debug Python
