# Dynamo graph Lines.Join or Extract By Angle Range.dyn (Dynamo 2.13.1.3887)
# author: karam@aecedx.com
# packages: Synthesize toolkit 12.5.1

# group: Input
n03_delete_original = BoolSelector(true)  # "03.Delete Original ?"; graph input
n01_select_curves = DSModelElementsSelection()  # "01.Select Curves"; nothing selected; graph input
apply_nurbs_curve_fix_use_only = BoolSelector(false)  # "Apply Nurbs Curve Fix ? (Use Only If You Noticed Unexpected Result)"
n02_maximum_angle_detection_range = DoubleInput(50)  # "02.Maximum Angle (Detection Range)"; graph input
n04_flatten_to_nearest_level = BoolSelector(true)  # "04.Flatten to Nearest Level ?"; graph input
n05_number_of_control_points = DoubleInput(215)  # "05.Number of Control Points Desired (Per Line)"; graph input
exact_same_edge_ignores_number = BoolSelector(false)  # "Exact Same Edge (Ignores Number of Control Points Desired) Useful for Converting Into Smart Lines, However it set to False, the Lines will try to Join"
split_normalize_factor_exact = DoubleSlider(0.5, range=0..1 step 0.01)  # "Split Normalize Factor (Exact Same Line Must be Disabled, Works for Closed Loops Only)"
n06_detail_line_false_model_line = BoolSelector(true)  # "06.Detail Line = False | Model Line = True"; graph input

curves = Element.Curves(element=n01_select_curves)
isEmpty = List.IsEmpty(list=curves@L2)
filterByBoolMask = List.FilterByBoolMask(list=n01_select_curves, mask=isEmpty)
code_block = CodeBlock { null; }
code_block_2 = CodeBlock { false; }
clean = List.Clean(list=curves, preserveIndices=code_block_2)
flatten = List.Flatten(list=clean)
scopeIf = Custom[CW.ScopeIf+](VARtest=apply_nurbs_curve_fix_use_only, VARtrue=code_block, VARfalse=flatten)  # package Synthesize toolkit; A (hopefully) more robust implementation of ScopeIf. Tests a single boolean and returns a value accordingly.
code_block_3 = CodeBlock { false; }
clean_2 = List.Clean(list=scopeIf, preserveIndices=code_block_3)
scopeIf_2 = Custom[CW.ScopeIf+](VARtest=apply_nurbs_curve_fix_use_only, VARtrue=flatten, VARfalse=code_block)
clean_3 = List.Clean(list=scopeIf_2, preserveIndices=code_block_3)
toNurbsCurve = Curve.ToNurbsCurve(curve=clean_3)
create = List.Create(item0=clean_2, item1=toNurbsCurve)
code_block_4 = CodeBlock { false; }
clean_4 = List.Clean(list=create, preserveIndices=code_block_4)
flatten_2 = List.Flatten(list=clean_4)
as_polycurve_bycurves = Custom[AS.[&] PolyCurve.ByCurves](VARcurves=flatten_2)  # package Synthesize toolkit; Create polycurves from an unordered list of curves.
join_or_extract_by_angle_range = Custom[Join or Extract By Angle Range](VARCurves=as_polycurve_bycurves.VARpolyCurve@L1, VARMaximumAngleDetectionRange=n02_maximum_angle_detection_range, VARFlattentoNearestLevel=n04_flatten_to_nearest_level, VARNumberofControlPointsDesired=n05_number_of_control_points, VARExactSameLineIgnoresNumberofControlPointsDesiredUsefulforConvertingIntoSmartLines=exact_same_edge_ignores_number, VARSplitNormalizeFactorExactSameLineMustbeFasleWorksforClosedLoopsOnly=split_normalize_factor_exact)  # package Synthesize toolkit; Join or Extract By Angle Range
flatten_3 = List.Flatten(list=join_or_extract_by_angle_range)
byCurve = ModelCurve.ByCurve(curve=flatten_3)
model_line_or_detail_line_from = Custom[Model Line or Detail Line From (Model Line)](VARDetailLine=n06_detail_line_false_model_line, VARModelCurve=byCurve)  # package Synthesize toolkit; Model Line or Detail Line From (Model Line)
create_2 = List.Create(item0=byCurve, item1=model_line_or_detail_line_from.VARDetailLines)
code_block_5 = CodeBlock { false; }
clean_5 = List.Clean(list=create_2, preserveIndices=code_block_5)
flatten_4 = List.Flatten(list=clean_5)
passthrough = Custom[CW.Passthrough](VARpassThrough=filterByBoolMask.out, VARwaitFor=flatten_4)  # package Synthesize toolkit; Forces a sequential order of execution. The node wired into the output of the Passthrough node will be executed *after* the node wired into the waitFor input (e.g. important for some Revit operations). The value of the passThrough input will be passed on to the node wired into the output port of the Passthrough node.
code_block_6 = CodeBlock { null; }
scopeIf_3 = Custom[CW.ScopeIf+](VARtest=n03_delete_original, VARtrue=passthrough, VARfalse=code_block_6)
clean_6 = List.Clean(list=scopeIf_3)
eraser = Custom[ST.Tool.Eraser](VARList=clean_6)  # package Synthesize toolkit; Try to delete any element from project
debug_python_no_message = Custom[Debug Python No Message]()  # package Synthesize toolkit; Debug Python
