# Dynamo graph Lines.Join or Extract By Linestyle.dyn (Dynamo 2.13.1.3887)
# author: karam@aecedx.com
# packages: Synthesize toolkit 12.5.1

# group: Input
n02_delete_original = BoolSelector(true)  # "02.Delete Original ?"; graph input
n01_linestyle_to_select = StringInput("Thin Lines")  # "01.Linestyle to Select"; graph input
n04_number_of_control_points = DoubleInput(100)  # "04.Number of Control Points Desired"; graph input
with_points_conceptual = BoolSelector(false)  # "With Points ? (Conceptual Environment Only)"
n03_flatten_to_nearest_level = BoolSelector(false)  # "03.Flatten to Nearest Level ?"; graph input
exact_same_edge_ignores_number = BoolSelector(false)  # "Exact Same Edge (Ignores Number of Control Points Desired) Useful for Converting Into Smart Lines, However it set to False, the Lines will try to Join"
split_normalize_factor_exact = DoubleSlider(0.5, range=0..1 step 0.01)  # "Split Normalize Factor (Exact Same Line Must be Disabled, Works for Closed Loops Only)"
n05_detail_line_false_model_line = BoolSelector(true)  # "05.Detail Line = False | Model Line = True"; graph input

default_linestyles_name_revit = Custom[Default Linestyles Name Revit Compatiblity](VARLinestylename=n01_linestyle_to_select)  # package Synthesize toolkit; Default Linestyles Name Revit Compatiblity
al_select_model_lines_by_style = Custom[AL.Select Model Lines by Style](VARStyleName=default_linestyles_name_revit)  # package Synthesize toolkit; This node will select all model lines in the revit project by a line style name.
al_select_detail_lines_by_style = Custom[AL.Select Detail Lines by Style](VARStyleName=default_linestyles_name_revit)  # package Synthesize toolkit; This node will select all model lines in the revit project by a line style name.
create = List.Create(item0=al_select_model_lines_by_style, item1=al_select_detail_lines_by_style)
flatten = List.Flatten(list=create)
code_block = CodeBlock { false; }
clean = List.Clean(list=flatten, preserveIndices=code_block)
curve = CurveElement.Curve()  # unwired: curveElement
map = List.Map(list=clean, f_x=curve)
code_block_2 = CodeBlock { false; }
clean_2 = List.Clean(list=map, preserveIndices=code_block_2)
flatten_2 = List.Flatten(list=clean_2)
as_polycurve_bycurves = Custom[AS.[&] PolyCurve.ByCurves](VARcurves=flatten_2)  # package Synthesize toolkit; Create polycurves from an unordered list of curves.
create_2 = List.Create(item0=as_polycurve_bycurves.VARpolyCurve)
code_block_3 = CodeBlock { false; }
clean_3 = List.Clean(list=create_2, preserveIndices=code_block_3)
flatten_3 = List.Flatten(list=clean_3)
generate_lines_helper_for_smart = Custom[Generate Lines (Helper for Smart Arcs Detection)](VARCurves=flatten_3, VARExactSameEdgeIgnoresNumberofControlPointsDesiredUsefulforConvertingIntoSmartLinesHoweveritsettoTruetheLineswilltrytoJoin=exact_same_edge_ignores_number, VARWithPointsConceptualEnvironmentOnly=with_points_conceptual)  # package Synthesize toolkit; Generate Lines (Helper for Smart Lines)
generate_lines_smart_with_auto = Custom[Generate Lines (Smart with Auto compatibility with Revit)](VARNumberofControlPointsPerLine=n04_number_of_control_points, VARWithPoints=with_points_conceptual, VARFlattentoNearestLevel=n03_flatten_to_nearest_level, VARExactSameLineIgnoresNumberofControlPointsDesiredUsefulforConvertingIntoSmartLines=exact_same_edge_ignores_number, VARSplitNormalizeFactorExactSameLineMustbeFasleWorksforClosedLoopsOnly=split_normalize_factor_exact, VARCurves=generate_lines_helper_for_smart.VARCurves)  # package Synthesize toolkit; Generate Lines (Smart with Auto compatibility with Revit)
flatten_4 = List.Flatten(list=generate_lines_smart_with_auto.VARModelCurves)
passthrough = Custom[CW.Passthrough](VARpassThrough=clean, VARwaitFor=flatten_4)  # package Synthesize toolkit; Forces a sequential order of execution. The node wired into the output of the Passthrough node will be executed *after* the node wired into the waitFor input (e.g. important for some Revit operations). The value of the passThrough input will be passed on to the node wired into the output port of the Passthrough node.
code_block_4 = CodeBlock { null; }
scopeIf = Custom[CW.ScopeIf+](VARtest=n02_delete_original, VARtrue=passthrough, VARfalse=code_block_4)  # package Synthesize toolkit; A (hopefully) more robust implementation of ScopeIf. Tests a single boolean and returns a value accordingly.
code_block_5 = CodeBlock { false; }
clean_4 = List.Clean(list=scopeIf, preserveIndices=code_block_5)
eraser = Custom[ST.Tool.Eraser](VARList=clean_4)  # package Synthesize toolkit; Try to delete any element from project
create_3 = List.Create(item0=generate_lines_smart_with_auto.VARModelCurves, item1=generate_lines_helper_for_smart.VARModelCurves)
model_line_or_detail_line_from = Custom[Model Line or Detail Line From (Model Line)](VARDetailLine=n05_detail_line_false_model_line, VARModelCurve=create_3)  # package Synthesize toolkit; Model Line or Detail Line From (Model Line)
debug_python_no_message = Custom[Debug Python No Message]()  # package Synthesize toolkit; Debug Python
