# Dynamo graph Lines.K-Laser By Elements Selection.dyn (Dynamo 2.13.1.3887)
# author: karam@aecedx.com
# packages: Synthesize toolkit 12.5.1

# group: Input
n07_create_selection_filter_3d = BoolSelector(true)  # "07.Create Selection Filter (3D Surfaces & Model Text) ?"; graph input
n08_filter_name_3d_surfaces_model = StringInput("Dynamo K-Laser 3D Surfaces & Moxel Text")  # "08.Filter Name (3D Surfaces & Model Text)"; graph input
n06_text_type_in_drafting_view = StringInput("8mm Arial")  # "06.Text Type In Drafting View (Empty Will Use Default)"; graph input
n05_distance_between_laser_pieces = DoubleInput(5)  # "05.Distance Between Laser Pieces In Drafting View"; graph input
n04_drafting_view_name = StringInput("K-Laser")  # "04.Drafting View Name"; graph input
n03_folds_dashes_spacing = DoubleInput(0.1)  # "03.Folds Dashes Spacing"; graph input
n02_method_1_vertical_faces_2 = IntegerSlider(4, range=1..4 step 1)  # "02.Method (1 = Vertical Faces | 2 = Horizontal Up Faces | 3 = Horizontal Down Faces | 4 = All Faces)"; graph input
n01_select_elements_surfaces = DSModelElementsSelection()  # "01.Select Elements (Surfaces Prefered)"; nothing selected; graph input
n09_pin_3d_surfaces_model_text = BoolSelector(true)  # "09.Pin 3D Surfaces & Model Text ?"; graph input

code_block = CodeBlock { false; }
python_script = Python()  # IronPython2; unwired: IN[0]
# ---------- python_script.python (77 lines) ----------
import sys
sys.path.append(r'C:\Program Files (x86)\IronPython 2.7\DLLs')
sys.path.append(r'C:\Program Files (x86)\IronPython 2.7\Lib')
from System.Net import WebRequest
import urllib2
import urllib
import os
import clr
# Adding the DynamoRevitDS.dll module to work with the Dynamo API
clr.AddReference('DynamoRevitDS')
import Dynamo 
clr.AddReference('DSCoreNodes')
import DSCore
from DSCore import *
clr.AddReference('RevitAPI')
# Enable DocumentManager and TransactionManager
clr.AddReference('RevitServices')
from RevitServices.Persistence import DocumentManager
from RevitServices.Transactions import TransactionManager
# access to the current Dynamo instance and workspace
import System
from System.Collections.Generic import *
import clr
clr.AddReference('RevitAPI') 
import Autodesk
from Autodesk.Revit.DB import *
clr.AddReference('RevitAPIUI') 


clr.AddReference('ProtoGeometry')
from Autodesk.DesignScript.Geometry import *
clr.AddReference('RevitNodes')
import Revit
clr.ImportExtensions(Revit.GeometryConversion)

# Choose The Current Document
doc = DocumentManager.Instance.CurrentDBDocument
uidoc = DocumentManager.Instance.CurrentUIApplication.ActiveUIDocument
uiapp = DocumentManager.Instance.CurrentUIApplication
app = uiapp.Application

script = Dynamo.Applications.DynamoRevit().RevitDynamoModel.CurrentWorkspace.FileName.split("\\")[:-1]
fullpath = "\\".join(script) + "\\Sample Model Text Workplane.rfa"

#Family symbol name to place.
symbName = 'Sample Model Text Workplane'
 
#create a filtered element collector set to Category OST_Mass and Class FamilySymbol 
collector = FilteredElementCollector(doc)
collector.OfCategory(BuiltInCategory.OST_Entourage)
collector.OfClass(FamilySymbol)
famtypeitr = collector.GetElementIterator()

re = [x for x in FilteredElementCollector(doc).OfClass(FamilySymbol).ToElements() if symbName.lower() == x.FamilyName.lower()]

TransactionManager.Instance.EnsureInTransaction(doc)
if re == []:
	load = doc.LoadFamily(fullpath)
	#create a filtered element collector set to Category OST_Mass and Class FamilySymbol 
	collector = FilteredElementCollector(doc)
	collector.OfCategory(BuiltInCategory.OST_Entourage)
	collector.OfClass(FamilySymbol)
	famtypeitr = collector.GetElementIterator()
	#Search Family Symbols in document.
	for item in famtypeitr:
		famtypeID = item
		#re.append(item)
		if symbName in item.FamilyName:
			re = item
			if not re.IsActive: re.Activate()
			break
else:
	re = re[-1]
	if not re.IsActive: re.Activate()
TransactionManager.Instance.TransactionTaskDone()
	
OUT = re
# ----------------------------------------
all_elements_of_family_type = ElementsOfFamilyType(Family_Type=python_script)
code_block_2 = CodeBlock { 4; 1; 2; 3; null; false; }
eq = n02_method_1_vertical_faces_2 == code_block_2.out0
element_geometry_fixer = Custom[Element.Geometry Fixer](VARElement=n01_select_elements_surfaces)  # package Synthesize toolkit; Element.Geometry Fixer
flatten = List.Flatten(list=element_geometry_fixer)
explode = Geometry.Explode(geometry=flatten)
code_block_3 = CodeBlock { "Surface"; }
byClassName = Custom[SP.Filter.ByClassName](VARobject=explode, VARclassName=code_block_3)  # package Synthesize toolkit; Filters a list of objects by the object's class name. Note that Dynamo elements belong to different classes than their Revit counterparts. Use the Object.Class node to check an object's class.
flatten_2 = List.Flatten(list=byClassName.VARin)
scopeIf = Custom[CW.ScopeIf+](VARtest=eq, VARtrue=flatten_2, VARfalse=code_block_2.out4)  # package Synthesize toolkit; A (hopefully) more robust implementation of ScopeIf. Tests a single boolean and returns a value accordingly.
eq_2 = n02_method_1_vertical_faces_2 == code_block_2.out1
filterByOrientation = Custom[CW.Surface.FilterByOrientation](VARsurfaces=flatten_2@L2)  # package Synthesize toolkit; Sorts surfaces in three lists based on their orientation (vertical, horizontal up & horizontal down) and also returns three corresponding lists of booleans.
python_empty_2_null = Custom[Python Empty 2 Null](VARIN=filterByOrientation.VARvertical)  # package Synthesize toolkit; Python Null 2 Empty
scopeIf_2 = Custom[CW.ScopeIf+](VARtest=eq_2, VARtrue=python_empty_2_null, VARfalse=code_block_2.out4)
eq_3 = n02_method_1_vertical_faces_2 == code_block_2.out2
python_empty_2_null_2 = Custom[Python Empty 2 Null](VARIN=filterByOrientation.VARhorizontalUp)
scopeIf_3 = Custom[CW.ScopeIf+](VARtest=eq_3, VARtrue=python_empty_2_null_2, VARfalse=code_block_2.out4)
eq_4 = n02_method_1_vertical_faces_2 == code_block_2.out3
python_empty_2_null_3 = Custom[Python Empty 2 Null](VARIN=filterByOrientation.VARhorizontalDown)
scopeIf_4 = Custom[CW.ScopeIf+](VARtest=eq_4, VARtrue=python_empty_2_null_3, VARfalse=code_block_2.out4)
create = List.Create(item0=scopeIf, item1=scopeIf_2, item2=scopeIf_3, item3=scopeIf_4)
clean = List.Clean(list=create, preserveIndices=code_block_2.out5)
flatten_3 = List.Flatten(list=clean)
code_block_4 = CodeBlock { 1; }
chop = List.Chop(list=flatten_3, lengths=code_block_4)
rank = List.Rank(list=chop)
code_block_5 = CodeBlock { 2; }
lt = rank < code_block_5
create_2 = List.Create(item0=chop)
scopeIf_5 = Custom[CW.ScopeIf+](VARtest=lt, VARtrue=create_2, VARfalse=chop)
isPlanar = Custom[CW.Surface.IsPlanar](VARsurface=scopeIf_5)  # package Synthesize toolkit; Checks whether a face is planar
filterByBoolMask = List.FilterByBoolMask(list=scopeIf_5, mask=isPlanar)
surface_importer = Custom[Surface Importer](VARSurfaces=filterByBoolMask.in)  # package Synthesize toolkit; Surface Importer Node
surfaces = PolySurface.Surfaces(polySurface=surface_importer)
code_block_6 = CodeBlock { false; }
clean_2 = List.Clean(list=filterByBoolMask.out, preserveIndices=code_block_6)
area = Surface.Area(surface=clean_2)
maximumItem = List.MaximumItem(list=area)
eq_5 = maximumItem == area
filterByBoolMask_2 = List.FilterByBoolMask(list=clean_2, mask=eq_5)
isEmpty = List.IsEmpty(list=filterByBoolMask_2.out, lacing=Longest)
filterByBoolMask_3 = List.FilterByBoolMask(list=filterByBoolMask_2.in, mask=isEmpty)
tesselateSurfaces = DynamoUnfold.Unfolding._TesselateSurfaces(surfaces=filterByBoolMask_3.out)
filterByBoolMask_4 = List.FilterByBoolMask(list=filterByBoolMask_2.out, mask=isEmpty)
thicken = Surface.Thicken(surface=filterByBoolMask_4.out)
python_script_2 = Python(IN[0]=tesselateSurfaces, IN[1]=thicken)  # IronPython2
# ---------- python_script_2.python (65 lines) ----------
# Enable Python support and load DesignScript library
# IMPORTANT : ALL DYNAMO DESIGN SCRIPT NODES ARE AS (dg)
import clr
clr.AddReference('ProtoGeometry')
from Autodesk.DesignScript import Geometry as dg

# EXTENSION Enable ToDSType
clr.AddReference('RevitNodes')
import Revit
clr.ImportExtensions(Revit.Elements)

# Enable Revit Elements
from Revit.Elements import *

# EXTENSION Enable Geometry Conversion Methods
clr.ImportExtensions(Revit.GeometryConversion)

# Enable Revit API
clr.AddReference('RevitAPI')
from Autodesk.Revit.DB import *

# Enable DocumentManager and TransactionManager
clr.AddReference('RevitServices')
from RevitServices.Persistence import DocumentManager
from RevitServices.Transactions import TransactionManager

# Enable ICollection List Translate
clr.AddReference("System")
import System.Collections.Generic
from System.Collections.Generic import List

dataEnteringNode = IN
# Use UnwrapElement(IN[0]) When Translating From Dynamo to Revit
surflist=UnwrapElement(IN[0])
solidlist=UnwrapElement(IN[1])

# Choose The Current Document
doc = DocumentManager.Instance.CurrentDBDocument
uidoc = DocumentManager.Instance.CurrentUIApplication.ActiveUIDocument
uiapp = DocumentManager.Instance.CurrentUIApplication
app = uiapp.Application

# Create Empty List
result = []

countglobal = 0
for elist in surflist:
	tmp = []
	for e in elist:
		boolcheck = []
		for s in solidlist[countglobal]:
			if dg.Geometry.DoesIntersect(e,s):
				tmp.append(dg.Surface.SubtractFrom(e,s))
				boolcheck.append(True)
			else:
				boolcheck.append(False)
		if any(boolcheck):
			pass
		else:
			tmp.append(e)
	countglobal = countglobal + 1
	result.append(tmp)

# Assign your output to the OUT variable.
OUT = result
# ----------------------------------------
flatten_4 = List.Flatten(list=python_script_2@L3)
flatten_5 = List.Flatten(list=filterByBoolMask_3.in)
tesselateSurfaces_2 = DynamoUnfold.Unfolding._TesselateSurfaces(surfaces=flatten_5)
create_3 = List.Create(item0=surfaces, item1=flatten_4, item2=tesselateSurfaces_2)
code_block_7 = CodeBlock { false; }
clean_3 = List.Clean(list=create_3, preserveIndices=code_block_7)
flatten_6 = List.Flatten(list=clean_3)
python_script_3 = Python(IN[0]=flatten_6)  # IronPython2
# ---------- python_script_3.python (96 lines) ----------
# Enable Python support and load DesignScript library
# IMPORTANT : ALL DYNAMO DESIGN SCRIPT NODES ARE AS (dg)
import clr
clr.AddReference('ProtoGeometry')
from Autodesk.DesignScript import Geometry as dg

# EXTENSION Enable ToDSType
clr.AddReference('RevitNodes')
import Revit
clr.ImportExtensions(Revit.Elements)

# Enable Revit Elements
from Revit.Elements import *

# EXTENSION Enable Geometry Conversion Methods
clr.ImportExtensions(Revit.GeometryConversion)

# Enable Revit API
clr.AddReference('RevitAPI')
from Autodesk.Revit.DB import *

# Enable DocumentManager and TransactionManager
clr.AddReference('RevitServices')
from RevitServices.Persistence import DocumentManager
from RevitServices.Transactions import TransactionManager

# Enable ICollection List Translate
clr.AddReference("System")
import System.Collections.Generic
from System.Collections.Generic import List

dataEnteringNode = IN
# Use UnwrapElement(IN[0]) When Translating From Dynamo to Revit
surfaces=UnwrapElement(IN[0])

def isplanarsurf(s):
	norms = [0,0.333,0.666,1]
	pts = []
	for n in norms:
		for n2 in norms:
			pts.append(dg.Surface.PointAtParameter(s,n,n2))
	plane = dg.Plane.ByBestFitThroughPoints(pts)
	status = True
	for p in pts:
		try:
			inter = dg.Geometry.DoesIntersect(p,plane)
			if inter == False:
				status = False
				break
		except:
			pass
	return status

def iscurveplanar(curve):
	try:
		stp = curve.StartPoint
		end = curve.EndPoint
		length1 = round(dg.Line.ByStartPointEndPoint(stp,end).Length,2)
		length2 = round(curve.Length,2)
		if length1 == length2:
			return True
		else:
			return False
	except:
		return False

# Create Empty List
result = []

for s in surfaces:
	if isplanarsurf(s):
		perm = s.PerimeterCurves()
		try:
			dg.PolyCurve.ByJoinedCurves(perm)
			goodlines = True
			for p in perm:
				if iscurveplanar(p) == False:
					goodlines = False
					break
			if goodlines:
				pts = []
				for p in perm:
					pts.append(p.StartPoint)
				try:
					result.append(dg.Surface.ByPerimeterPoints(pts))
				except:
					result.append(s)
			else:
				result.append(s)
		except:
			result.append(s)
	else:
		result.append(s)

# Assign your output to the OUT variable.
OUT = result
# ----------------------------------------
unfoldListOfSurfaces = DynamoUnfold.Unfolding.UnfoldListOfSurfaces(surfaces=python_script_3)
k_laser_engine = Custom[K-Laser Engine](VARTextTypeInDraftingView=n06_text_type_in_drafting_view, VARDistanceBetweenLaserPiecesInDraftingView=n05_distance_between_laser_pieces, VARDraftingViewName=n04_drafting_view_name, VARSegmentationDistance=n03_folds_dashes_spacing, VARElementsModelText=all_elements_of_family_type, VARUnfoldedSurfaces=unfoldListOfSurfaces, VARModelTextFamilyType=python_script)  # package Synthesize toolkit; K-Laser Engine
generate_selection_filter = Custom[Generate Selection Filter](VARCreateSelectionFilter=n07_create_selection_filter_3d, VARFilterNametoCreate=n08_filter_name_3d_surfaces_model, VAROverwriteExistingFilter=code_block, VARElements=k_laser_engine.VAROutputFilter)  # package Synthesize toolkit; Generate Selection FIlter
setPinnedStatus = Custom[RH.Element.SetPinnedStatus](VARelement=k_laser_engine.VAROutputFilter, VARBool=n09_pin_3d_surfaces_model_text)  # package Synthesize toolkit; Will set the element to either pinned or not pinned. True is pinned, false is unpinned. For multiple elements use List.Map
debug_python = Custom[Debug Python]()  # package Synthesize toolkit; Debug Python
