# Dynamo graph Lines.K-Laser By Faces Selection.dyn (Dynamo 2.13.1.3887)
# author: karam@aecedx.com
# packages: Synthesize toolkit 12.5.1

# group: Input
n06_create_selection_filter_3d = BoolSelector(true)  # "06.Create Selection Filter (3D Surfaces & Model Text) ?"; graph input
n07_filter_name_3d_surfaces_model = StringInput("Dynamo K-Laser 3D Surfaces & Moxel Text")  # "07.Filter Name (3D Surfaces & Model Text)"; graph input
n05_text_type_in_drafting_view = StringInput("8mm Arial")  # "05.Text Type In Drafting View (Empty Will Use Default)"; graph input
n04_distance_between_laser_pieces = DoubleInput(5)  # "04.Distance Between Laser Pieces In Drafting View"; graph input
n03_drafting_view_name = StringInput("K-Laser")  # "03.Drafting View Name"; graph input
n02_folds_dashes_spacing = DoubleInput(0.1)  # "02.Folds Dashes Spacing"; graph input
n01_select_faces = SelectFaces()  # "01.Select Faces"; nothing selected; graph input
n08_pin_3d_surfaces_model_text = BoolSelector(true)  # "08.Pin 3D Surfaces & Model Text ?"; graph input

code_block = CodeBlock { false; }
python_script = Python()  # IronPython2; unwired: IN[0]
# ---------- python_script.python (77 lines) ----------
import sys
sys.path.append(r'C:\Program Files (x86)\IronPython 2.7\DLLs')
sys.path.append(r'C:\Program Files (x86)\IronPython 2.7\Lib')
from System.Net import WebRequest
import urllib2
import urllib
import os
import clr
# Adding the DynamoRevitDS.dll module to work with the Dynamo API
clr.AddReference('DynamoRevitDS')
import Dynamo 
clr.AddReference('DSCoreNodes')
import DSCore
from DSCore import *
clr.AddReference('RevitAPI')
# Enable DocumentManager and TransactionManager
clr.AddReference('RevitServices')
from RevitServices.Persistence import DocumentManager
from RevitServices.Transactions import TransactionManager
# access to the current Dynamo instance and workspace
import System
from System.Collections.Generic import *
import clr
clr.AddReference('RevitAPI') 
import Autodesk
from Autodesk.Revit.DB import *
clr.AddReference('RevitAPIUI') 


clr.AddReference('ProtoGeometry')
from Autodesk.DesignScript.Geometry import *
clr.AddReference('RevitNodes')
import Revit
clr.ImportExtensions(Revit.GeometryConversion)

# Choose The Current Document
doc = DocumentManager.Instance.CurrentDBDocument
uidoc = DocumentManager.Instance.CurrentUIApplication.ActiveUIDocument
uiapp = DocumentManager.Instance.CurrentUIApplication
app = uiapp.Application

script = Dynamo.Applications.DynamoRevit().RevitDynamoModel.CurrentWorkspace.FileName.split("\\")[:-1]
fullpath = "\\".join(script) + "\\Sample Model Text Workplane.rfa"

#Family symbol name to place.
symbName = 'Sample Model Text Workplane'
 
#create a filtered element collector set to Category OST_Mass and Class FamilySymbol 
collector = FilteredElementCollector(doc)
collector.OfCategory(BuiltInCategory.OST_Entourage)
collector.OfClass(FamilySymbol)
famtypeitr = collector.GetElementIterator()

re = [x for x in FilteredElementCollector(doc).OfClass(FamilySymbol).ToElements() if symbName.lower() == x.FamilyName.lower()]

TransactionManager.Instance.EnsureInTransaction(doc)
if re == []:
	load = doc.LoadFamily(fullpath)
	#create a filtered element collector set to Category OST_Mass and Class FamilySymbol 
	collector = FilteredElementCollector(doc)
	collector.OfCategory(BuiltInCategory.OST_Entourage)
	collector.OfClass(FamilySymbol)
	famtypeitr = collector.GetElementIterator()
	#Search Family Symbols in document.
	for item in famtypeitr:
		famtypeID = item
		#re.append(item)
		if symbName in item.FamilyName:
			re = item
			if not re.IsActive: re.Activate()
			break
else:
	re = re[-1]
	if not re.IsActive: re.Activate()
TransactionManager.Instance.TransactionTaskDone()
	
OUT = re
# ----------------------------------------
all_elements_of_family_type = ElementsOfFamilyType(Family_Type=python_script)
update_dynamo_wait = Custom[Update Dynamo Wait](VARWait=n01_select_faces)  # package Synthesize toolkit; Update Dynamo Wait
rank = List.Rank(list=update_dynamo_wait)
code_block_2 = CodeBlock { 2; }
lt = rank < code_block_2
create = List.Create(item0=update_dynamo_wait)
scopeIf = Custom[CW.ScopeIf+](VARtest=lt, VARtrue=create, VARfalse=update_dynamo_wait)  # package Synthesize toolkit; A (hopefully) more robust implementation of ScopeIf. Tests a single boolean and returns a value accordingly.
isPlanar = Custom[CW.Surface.IsPlanar](VARsurface=scopeIf)  # package Synthesize toolkit; Checks whether a face is planar
filterByBoolMask = List.FilterByBoolMask(list=scopeIf, mask=isPlanar)
surface_importer = Custom[Surface Importer](VARSurfaces=filterByBoolMask.in@L2)  # package Synthesize toolkit; Surface Importer Node
flatten = List.Flatten(list=surface_importer)
python_script_2 = Python(IN[0]=flatten)  # IronPython2
# ---------- python_script_2.python (55 lines) ----------
# Enable Python support and load DesignScript library
# IMPORTANT : ALL DYNAMO DESIGN SCRIPT NODES ARE AS (dg)
import clr
clr.AddReference('ProtoGeometry')
from Autodesk.DesignScript import Geometry as dg

# EXTENSION Enable ToDSType
clr.AddReference('RevitNodes')
import Revit
clr.ImportExtensions(Revit.Elements)

# Enable Revit Elements
from Revit.Elements import *

# EXTENSION Enable Geometry Conversion Methods
clr.ImportExtensions(Revit.GeometryConversion)

# Enable Revit API
clr.AddReference('RevitAPI')
from Autodesk.Revit.DB import *

# Enable DocumentManager and TransactionManager
clr.AddReference('RevitServices')
from RevitServices.Persistence import DocumentManager
from RevitServices.Transactions import TransactionManager

# Enable ICollection List Translate
clr.AddReference("System")
import System.Collections.Generic
from System.Collections.Generic import List

dataEnteringNode = IN
# Use UnwrapElement(IN[0]) When Translating From Dynamo to Revit
polysurf=UnwrapElement(IN[0])

# Choose The Current Document
doc = DocumentManager.Instance.CurrentDBDocument
uidoc = DocumentManager.Instance.CurrentUIApplication.ActiveUIDocument
uiapp = DocumentManager.Instance.CurrentUIApplication
app = uiapp.Application

result = []

try:
	for each in polysurf:
		try:
			if each != None:
				result.append(each.Surfaces())
		except:
			pass
except:
	pass

# Assign your output to the OUT variable.
OUT = result
# ----------------------------------------
join = List.Join()  # unwired: list0, list1
code_block_3 = CodeBlock { false; }
clean = List.Clean(list=filterByBoolMask.out, preserveIndices=code_block_3)
count = List.Count(list=clean@L2)
code_block_4 = CodeBlock { 1; }
eq = count == code_block_4
filterByBoolMask_2 = List.FilterByBoolMask(list=clean, mask=eq)
perimeterCurves = Surface.PerimeterCurves(surface=filterByBoolMask_2.in)
as_polycurve_bycurves = Custom[AS.[&] PolyCurve.ByCurves](VARcurves=perimeterCurves)  # package Synthesize toolkit; Create polycurves from an unordered list of curves.
python_null_2_empty = Custom[Python Null 2 Empty](VARIN=as_polycurve_bycurves.VARpolyCurve)  # package Synthesize toolkit; Python Null 2 Empty
isNull = Object.IsNull(object=as_polycurve_bycurves.VARpolyCurve)
filterByBoolMask_3 = List.FilterByBoolMask(list=python_null_2_empty, mask=isNull)
flatten_2 = List.Flatten(list=filterByBoolMask_3.out@L3)
count_2 = List.Count(list=flatten_2@L2)
code_block_5 = CodeBlock { 1; }
gt = count_2 > code_block_5
filterByBoolMask_4 = List.FilterByBoolMask(list=filterByBoolMask_2.in, mask=gt)
filterByBoolMask_5 = List.FilterByBoolMask(list=flatten_2, mask=gt)
byPatch = Surface.ByPatch(closedCurve=filterByBoolMask_5.in)
area = Surface.Area(surface=byPatch)
maximumItem = List.MaximumItem(list=area)
eq_2 = area == maximumItem
filterByBoolMask_6 = List.FilterByBoolMask(list=filterByBoolMask_5.in, mask=eq_2)
trimWithEdgeLoops = Surface.TrimWithEdgeLoops(surface=filterByBoolMask_4.in, loops=filterByBoolMask_6.in)
trimWithEdgeLoops_2 = Surface.TrimWithEdgeLoops(surface=filterByBoolMask_4.in, loops=filterByBoolMask_6.out)
combine = List.Combine(comb=join, list1=trimWithEdgeLoops, list2=trimWithEdgeLoops_2)
mergeByBoolMask = Custom[SP.List.MergeByBoolMask](VARIn=combine, VAROut=filterByBoolMask_4.out, VARmask=gt)  # package Synthesize toolkit; Merge two lists by a boolean mask list. The true count in the mask should be the same as the length of the true list and vice versa for the false list.
mergeByBoolMask_2 = Custom[SP.List.MergeByBoolMask](VARIn=mergeByBoolMask, VAROut=filterByBoolMask_2.out, VARmask=eq)
surface_area_fixer = Custom[Surface.Area Fixer](surface=mergeByBoolMask_2)  # package Synthesize toolkit; Surface.Area Fixer
list_maximumitem_fixer = Custom[List.MaximumItem Fixer](list=surface_area_fixer)  # package Synthesize toolkit; List.MaximumItem Fixer
eq_3 = list_maximumitem_fixer == surface_area_fixer
filterByBoolMask_7 = List.FilterByBoolMask(list=mergeByBoolMask_2, mask=eq_3)
isEmpty = List.IsEmpty(list=filterByBoolMask_7.out, lacing=Longest)
filterByBoolMask_8 = List.FilterByBoolMask(list=filterByBoolMask_7.in, mask=isEmpty)
tesselateSurfaces = DynamoUnfold.Unfolding._TesselateSurfaces(surfaces=filterByBoolMask_8.out)
filterByBoolMask_9 = List.FilterByBoolMask(list=filterByBoolMask_7.out, mask=isEmpty)
thicken = Surface.Thicken(surface=filterByBoolMask_9.out)
python_script_3 = Python(IN[0]=tesselateSurfaces, IN[1]=thicken)  # IronPython2
# ---------- python_script_3.python (65 lines) ----------
# Enable Python support and load DesignScript library
# IMPORTANT : ALL DYNAMO DESIGN SCRIPT NODES ARE AS (dg)
import clr
clr.AddReference('ProtoGeometry')
from Autodesk.DesignScript import Geometry as dg

# EXTENSION Enable ToDSType
clr.AddReference('RevitNodes')
import Revit
clr.ImportExtensions(Revit.Elements)

# Enable Revit Elements
from Revit.Elements import *

# EXTENSION Enable Geometry Conversion Methods
clr.ImportExtensions(Revit.GeometryConversion)

# Enable Revit API
clr.AddReference('RevitAPI')
from Autodesk.Revit.DB import *

# Enable DocumentManager and TransactionManager
clr.AddReference('RevitServices')
from RevitServices.Persistence import DocumentManager
from RevitServices.Transactions import TransactionManager

# Enable ICollection List Translate
clr.AddReference("System")
import System.Collections.Generic
from System.Collections.Generic import List

dataEnteringNode = IN
# Use UnwrapElement(IN[0]) When Translating From Dynamo to Revit
surflist=UnwrapElement(IN[0])
solidlist=UnwrapElement(IN[1])

# Choose The Current Document
doc = DocumentManager.Instance.CurrentDBDocument
uidoc = DocumentManager.Instance.CurrentUIApplication.ActiveUIDocument
uiapp = DocumentManager.Instance.CurrentUIApplication
app = uiapp.Application

# Create Empty List
result = []

countglobal = 0
for elist in surflist:
	tmp = []
	for e in elist:
		boolcheck = []
		for s in solidlist[countglobal]:
			if dg.Geometry.DoesIntersect(e,s):
				tmp.append(dg.Surface.SubtractFrom(e,s))
				boolcheck.append(True)
			else:
				boolcheck.append(False)
		if any(boolcheck):
			pass
		else:
			tmp.append(e)
	countglobal = countglobal + 1
	result.append(tmp)

# Assign your output to the OUT variable.
OUT = result
# ----------------------------------------
flatten_3 = List.Flatten(list=python_script_3@L3)
flatten_4 = List.Flatten(list=filterByBoolMask_8.in)
tesselateSurfaces_2 = DynamoUnfold.Unfolding._TesselateSurfaces(surfaces=flatten_4)
create_2 = List.Create(item0=python_script_2, item1=flatten_3, item2=tesselateSurfaces_2)
code_block_6 = CodeBlock { false; }
clean_2 = List.Clean(list=create_2, preserveIndices=code_block_6)
flatten_5 = List.Flatten(list=clean_2)
python_script_4 = Python(IN[0]=flatten_5)  # IronPython2
# ---------- python_script_4.python (115 lines) ----------
# Enable Python support and load DesignScript library
# IMPORTANT : ALL DYNAMO DESIGN SCRIPT NODES ARE AS (dg)
import clr
clr.AddReference('ProtoGeometry')
from Autodesk.DesignScript import Geometry as dg

# EXTENSION Enable ToDSType
clr.AddReference('RevitNodes')
import Revit
clr.ImportExtensions(Revit.Elements)

# Enable Revit Elements
from Revit.Elements import *

# EXTENSION Enable Geometry Conversion Methods
clr.ImportExtensions(Revit.GeometryConversion)

# Enable Revit API
clr.AddReference('RevitAPI')
from Autodesk.Revit.DB import *

# Enable DocumentManager and TransactionManager
clr.AddReference('RevitServices')
from RevitServices.Persistence import DocumentManager
from RevitServices.Transactions import TransactionManager

# Enable ICollection List Translate
clr.AddReference("System")
import System.Collections.Generic
from System.Collections.Generic import List

dataEnteringNode = IN
# Use UnwrapElement(IN[0]) When Translating From Dynamo to Revit
surfaces=UnwrapElement(IN[0])

def flatten(x):
    result = []
    for el in x:
        if hasattr(el, "__iter__") and not isinstance(el, basestring):
            result.extend(flatten(el))
        else:
            result.append(el)
    return result

def isplanarsurf(s):
	norms = [0,0.333,0.666,1]
	pts = []
	for n in norms:
		for n2 in norms:
			pts.append(dg.Surface.PointAtParameter(s,n,n2))
	plane = dg.Plane.ByBestFitThroughPoints(pts)
	status = True
	for p in pts:
		try:
			inter = dg.Geometry.DoesIntersect(p,plane)
			if inter == False:
				status = False
				break
		except:
			pass
	return status

def iscurveplanar(curve):
	try:
		stp = curve.StartPoint
		end = curve.EndPoint
		length1 = round(dg.Line.ByStartPointEndPoint(stp,end).Length,2)
		length2 = round(curve.Length,2)
		if length1 == length2:
			return True
		else:
			return False
	except:
		return False

# Create Empty List
result = []

exploded = []
for s in surfaces:
	try:
		exploded.append(dg.Geometry.Explode(s))
	except:
		exploded.append(s)

exploded = flatten(exploded)
surfaces = exploded

for s in surfaces:
	if isplanarsurf(s):
		perm = s.PerimeterCurves()
		try:
			dg.PolyCurve.ByJoinedCurves(perm)
			goodlines = True
			for p in perm:
				if iscurveplanar(p) == False:
					goodlines = False
					break
			if goodlines:
				pts = []
				for p in perm:
					pts.append(p.StartPoint)
				try:
					result.append(dg.Surface.ByPerimeterPoints(pts))
				except:
					result.append(s)
			else:
				result.append(s)
		except:
			result.append(s)
	else:
		result.append(s)

# Assign your output to the OUT variable.
OUT = result
# ----------------------------------------
unfoldListOfSurfaces = DynamoUnfold.Unfolding.UnfoldListOfSurfaces(surfaces=python_script_4)
k_laser_engine = Custom[K-Laser Engine](VARTextTypeInDraftingView=n05_text_type_in_drafting_view, VARDistanceBetweenLaserPiecesInDraftingView=n04_distance_between_laser_pieces, VARDraftingViewName=n03_drafting_view_name, VARSegmentationDistance=n02_folds_dashes_spacing, VARElementsModelText=all_elements_of_family_type, VARUnfoldedSurfaces=unfoldListOfSurfaces, VARModelTextFamilyType=python_script)  # package Synthesize toolkit; K-Laser Engine
generate_selection_filter = Custom[Generate Selection Filter](VARCreateSelectionFilter=n06_create_selection_filter_3d, VARFilterNametoCreate=n07_filter_name_3d_surfaces_model, VAROverwriteExistingFilter=code_block, VARElements=k_laser_engine.VAROutputFilter)  # package Synthesize toolkit; Generate Selection FIlter
minimumItem = List.MinimumItem(list=area)
eq_4 = area == minimumItem
filterByBoolMask_10 = List.FilterByBoolMask(list=filterByBoolMask_5.in, mask=eq_4)
setPinnedStatus = Custom[RH.Element.SetPinnedStatus](VARelement=k_laser_engine.VAROutputFilter, VARBool=n08_pin_3d_surfaces_model_text)  # package Synthesize toolkit; Will set the element to either pinned or not pinned. True is pinned, false is unpinned. For multiple elements use List.Map
empty = List.Empty()
debug_python = Custom[Debug Python]()  # package Synthesize toolkit; Debug Python
