# Dynamo graph Lines.Rename Linestyles.dyn (Dynamo 2.13.1.3887)
# author: karam@aecedx.com
# packages: Synthesize toolkit 12.5.1

python_script = Python()  # IronPython2
# ---------- python_script.python (54 lines) ----------
# Enable Python support and load DesignScript library
# IMPORTANT : ALL DYNAMO DESIGN SCRIPT NODES ARE AS (dg)
import clr
clr.AddReference('ProtoGeometry')
from Autodesk.DesignScript import Geometry as dg

# EXTENSION Enable ToDSType
clr.AddReference('RevitNodes')
import Revit
clr.ImportExtensions(Revit.Elements)

# Enable Revit Elements
from Revit.Elements import *

# EXTENSION Enable Geometry Conversion Methods
clr.ImportExtensions(Revit.GeometryConversion)

# Enable Revit API
clr.AddReference('RevitAPI')
from Autodesk.Revit.DB import *

# Enable DocumentManager and TransactionManager
clr.AddReference('RevitServices')
from RevitServices.Persistence import DocumentManager
from RevitServices.Transactions import TransactionManager

# Enable ICollection List Translate
clr.AddReference("System")
import System.Collections.Generic
from System.Collections.Generic import List

# Choose The Current Document
doc = DocumentManager.Instance.CurrentDBDocument
uidoc = DocumentManager.Instance.CurrentUIApplication.ActiveUIDocument
uiapp = DocumentManager.Instance.CurrentUIApplication
app = uiapp.Application

# Create Empty List
result = []
names = []

c = doc.Settings.Categories.get_Item(BuiltInCategory.OST_Lines)
subcats = c.SubCategories
 
for lineStyle in subcats:
	elem = doc.GetElement(lineStyle.Id)
	result.append(elem)
	if elem != None:
		names.append(elem.Name)
	
resultclean = [x for x in result if x]

# Assign your output to the OUT variable.
OUT = resultclean,names
# ----------------------------------------
code_block = CodeBlock(a=python_script) { a[0]; a[1]; }

# group: Input
n03_insert_mode_1_insert_at = IntegerSlider(1, range=1..5 step 1)  # "03.Insert Mode : 1 = Insert at Beginning | 2 = Insert at End | 3 = Insert Before Word | 4 = Insert After Word | 5 = Replace Word"; graph input
n04_word_to_target_before_or = StringInput("")  # "04.Word to Target (Before or After Word or Replace Word Mode)"; graph input
n05_word_to_insert = StringInput("AEC_")  # "05.Word to Insert"; graph input
n01_search_mode_1_starts_with_2 = IntegerSlider(1, range=1..3 step 1)  # "01.Search Mode : 1 = Starts With | 2 = Ends With | 3 = Contains"; graph input
n02_string_to_search = StringInput("LineX")  # "02.String to Search"; graph input

searcher = Custom[Searcher](VARInsertMode1InsertatBeginning2InsertatEnd3InsertBeforeWord4InsertAfterWord5ReplaceWord=n03_insert_mode_1_insert_at, VARWordtoTargetBeforeorAfterWordorReplaceWordMode=n04_word_to_target_before_or, VARWordtoInsert=n05_word_to_insert, VARSearchMode1StartsWith2EndsWith3Contains=n01_search_mode_1_starts_with_2, VARStringtoSearch=n02_string_to_search, VARStringList=code_block.out1)  # package Synthesize toolkit; Searcher
filterByBoolMask = List.FilterByBoolMask(list=code_block.out0, mask=searcher.VARChangedItems)
filterByBoolMask_2 = List.FilterByBoolMask(list=searcher.VAROut, mask=searcher.VARChangedItems)
python_script_2 = Python(IN[0]=filterByBoolMask.in, IN[1]=filterByBoolMask_2.in)  # IronPython2
# ---------- python_script_2.python (61 lines) ----------
# Enable Python support and load DesignScript library
# IMPORTANT : ALL DYNAMO DESIGN SCRIPT NODES ARE AS (dg)
import clr
clr.AddReference('ProtoGeometry')
from Autodesk.DesignScript import Geometry as dg

# EXTENSION Enable ToDSType
clr.AddReference('RevitNodes')
import Revit
clr.ImportExtensions(Revit.Elements)

# Enable Revit Elements
from Revit.Elements import *

# EXTENSION Enable Geometry Conversion Methods
clr.ImportExtensions(Revit.GeometryConversion)

# Enable Revit API
clr.AddReference('RevitAPI')
from Autodesk.Revit.DB import *

# Enable DocumentManager and TransactionManager
clr.AddReference('RevitServices')
from RevitServices.Persistence import DocumentManager
from RevitServices.Transactions import TransactionManager

# Enable ICollection List Translate
clr.AddReference("System")
import System.Collections.Generic
from System.Collections.Generic import List

dataEnteringNode = IN
# Use UnwrapElement(IN[0]) When Translating From Dynamo to Revit
elems=UnwrapElement(IN[0])
names=UnwrapElement(IN[1])
# Choose The Current Document
doc = DocumentManager.Instance.CurrentDBDocument
uidoc = DocumentManager.Instance.CurrentUIApplication.ActiveUIDocument
uiapp = DocumentManager.Instance.CurrentUIApplication
app = uiapp.Application

# Create Empty List
result = []

# Start a Transaction with Current Document (doc)
TransactionManager.Instance.EnsureInTransaction(doc)

counter = 0
for e in elems:
	try:
		e.Name = names[counter]
	except:
		pass
	counter += 1

# End the Transaction with Current Document ()
TransactionManager.Instance.TransactionTaskDone()


# Assign your output to the OUT variable.
OUT = names
# ----------------------------------------
debug_python = Custom[Debug Python]()  # package Synthesize toolkit; Debug Python
