# Dynamo graph Materials.Create Filters For Transparent Elements.dyn (Dynamo 2.13.1.3887)
# author: karam@aecedx.com
# packages: Synthesize toolkit 12.5.1

code_block = CodeBlock { true; }

# group: Input
n02_transparent_elements_filter = StringInput("Dynamo Transparent Elements")  # "02.Transparent Elements Filter"; graph input
n01_overwrite_existing_filters = BoolSelector(true)  # "01.Overwrite Existing Filters"; graph input
n03_non_transparent_elements = StringInput("Dynamo Non-Transparent Elements")  # "03.Non-Transparent Elements Filter"; graph input

python_all_elements_in_active = Custom[Python All Elements In Active View]()  # package Synthesize toolkit; Python All Elements In Active View
getCategory = Element.GetCategory(element=python_all_elements_in_active)
string_from_object = FromObject(obj=getCategory)
system_categories = StringInput("Walls,Floors,Roofs,Ceilings")
python_script = Python(IN[0]=string_from_object, IN[1]=system_categories, IN[2]=python_all_elements_in_active)  # IronPython2
# ---------- python_script.python (22 lines) ----------
import clr
clr.AddReference('ProtoGeometry')
from Autodesk.DesignScript.Geometry import *
#The inputs to this node will be stored as a list in the IN variables.
dataEnteringNode = IN

list = IN[0]
exclude = IN[1]
elems = IN[2]

exclude = exclude.split(",")
result = []
count = 0
for l in list:
	current = elems[count]
	count += 1
	for e in exclude:
		if e == l:
			result.append(current)
			break
#Assign your output to the OUT variable.
OUT = result
# ----------------------------------------
removeListFromList = Custom[RH.RemoveListFromList](VARListA=python_all_elements_in_active, VARListB=python_script)  # package Synthesize toolkit; This node essentially "subtracts" the contents of List B from List A to produce a new list with the unique items.
elementType = Element.ElementType()  # unwired: element
groupByFunction = List.GroupByFunction(list=python_script, groupFunction=elementType)
flatten = List.Flatten(list=groupByFunction)
python_script_2 = Python(IN[0]=removeListFromList, IN[1]=flatten)  # IronPython2
# ---------- python_script_2.python (10 lines) ----------
import clr
clr.AddReference('ProtoGeometry')
from Autodesk.DesignScript.Geometry import *
#The inputs to this node will be stored as a list in the IN variables.
dataEnteringNode = IN

list1 = IN[0]
list2 = IN[1]

OUT = list1 + list2
# ----------------------------------------
getMaterials = Element.GetMaterials(element=removeListFromList)
firstItem = List.FirstItem(list=groupByFunction@L2)
elementType_2 = Element.ElementType(element=firstItem)
python_script_3 = Python(IN[0]=elementType_2)  # IronPython2
# ---------- python_script_3.python (32 lines) ----------
import clr
clr.AddReference('RevitAPI')
from Autodesk.Revit.DB import *

clr.AddReference("RevitNodes")
import Revit
clr.ImportExtensions(Revit.Elements)

items = UnwrapElement(IN[0])

def GetCompoundStructureLayers(item):
	layermat = []
	try:
		if hasattr(item, "GetCompoundStructure"):
			compstruc = item.GetCompoundStructure()
			num = compstruc.LayerCount
			counter = 0
			while counter < num:
				layermat.append(item.Document.GetElement(compstruc.GetMaterialId(counter)))
				counter += 1
		if len(layermat) > 1:
			newlayermat = []
			newlayermat.append(layermat[0])
			newlayermat.append(layermat[-1])
			layermat = newlayermat
	except: pass
	return layermat

result = []
for i in items:
	result.append(GetCompoundStructureLayers(i))
OUT = result
# ----------------------------------------
count = List.Count(list=groupByFunction@L2)
ofRepeatedItem = List.OfRepeatedItem(item=python_script_3, amount=count, lacing=Longest)
flatten_2 = List.Flatten(list=ofRepeatedItem@L2)
python_script_4 = Python(IN[0]=getMaterials, IN[1]=flatten_2)  # IronPython2; same code as python_script_2
isEmpty = List.IsEmpty(list=python_script_4, lacing=Longest)
filterByBoolMask = List.FilterByBoolMask(list=python_script_2, mask=isEmpty)
filterByBoolMask_2 = List.FilterByBoolMask(list=python_script_4, mask=isEmpty)
flatten_3 = List.Flatten(list=filterByBoolMask_2.out)
filter_transparent_materials = Custom[Filter Transparent Materials](VARMaterials=flatten_3)  # package Synthesize toolkit; Filter Transparent Materials
uniqueItems = List.UniqueItems(list=filter_transparent_materials)
id = Element.Id(element=uniqueItems)
id_2 = Element.Id(element=filterByBoolMask_2.out)
python_script_5 = Python(IN[0]=id, IN[1]=id_2)  # IronPython2
# ---------- python_script_5.python (20 lines) ----------
import clr
clr.AddReference('ProtoGeometry')
from Autodesk.DesignScript.Geometry import *
#The inputs to this node will be stored as a list in the IN variables.
dataEnteringNode = IN

tofilter = IN[0]
lists = IN[1]

result = []
for list in lists:
	status = False
	for f in tofilter:
		if f in list:
			status = True
			break
	result.append(status)
	
#Assign your output to the OUT variable.
OUT = result
# ----------------------------------------
filterByBoolMask_3 = List.FilterByBoolMask(list=filterByBoolMask.out, mask=python_script_5)
generate_selection_filter = Custom[Generate Selection Filter](VARCreateSelectionFilter=code_block, VARFilterNametoCreate=n02_transparent_elements_filter, VAROverwriteExistingFilter=n01_overwrite_existing_filters, VARElements=filterByBoolMask_3.in)  # package Synthesize toolkit; Generate Selection FIlter
getCategory_2 = Element.GetCategory(element=filterByBoolMask.in)
string_from_object_2 = FromObject(obj=getCategory_2)
excluded_categories = StringInput("Railings,Pads,Topography,Planting,Entourage")
python_script_6 = Python(IN[0]=string_from_object_2, IN[1]=excluded_categories, IN[2]=filterByBoolMask.in)  # IronPython2
# ---------- python_script_6.python (22 lines) ----------
import clr
clr.AddReference('ProtoGeometry')
from Autodesk.DesignScript.Geometry import *
#The inputs to this node will be stored as a list in the IN variables.
dataEnteringNode = IN

list = IN[0]
exclude = IN[1]
elems = IN[2]

exclude = exclude.split(",")
result = []
count = 0
for l in list:
	current = elems[count]
	count += 1
	for e in exclude:
		if e in l:
			result.append(current)
			break
#Assign your output to the OUT variable.
OUT = result
# ----------------------------------------
create = List.Create(item0=filterByBoolMask_3.out, item1=python_script_6)
code_block_2 = CodeBlock { false; }
clean = List.Clean(list=create, preserveIndices=code_block_2)
flatten_4 = List.Flatten(list=clean)
generate_selection_filter_2 = Custom[Generate Selection Filter](VARCreateSelectionFilter=code_block, VARFilterNametoCreate=n03_non_transparent_elements, VAROverwriteExistingFilter=n01_overwrite_existing_filters, VARElements=flatten_4)
debug_python_no_message = Custom[Debug Python No Message]()  # package Synthesize toolkit; Debug Python
