# Dynamo graph Materials.Delete.dyn (Dynamo 2.13.1.3887)
# author: karam@aecedx.com
# packages: Synthesize toolkit 12.5.1

# group: Input
n03_proceed = BoolSelector(false)  # "03.Proceed ?"; graph input
n02_false_delete_all_selected = BoolSelector(false)  # "02.False = Delete All Selected Materials | True = Delete All Not Selected Materials"; graph input
n01_material_name_contains = StringInput("SL-Green")  # "01.Material Name Contains"; graph input

code_block = CodeBlock { null; false; }
element_types = ElementTypes("Material")
all_elements_of_type = ElementsOfType(element_type=element_types)
name = Material.Name(material=all_elements_of_type)
contains = String.Contains(string=name, searchFor=n01_material_name_contains)
filterByBoolMask = List.FilterByBoolMask(list=all_elements_of_type, mask=contains)
scopeIf = Custom[CW.ScopeIf+](VARtest=n02_false_delete_all_selected, VARtrue=code_block.out0, VARfalse=filterByBoolMask.in)  # package Synthesize toolkit; A (hopefully) more robust implementation of ScopeIf. Tests a single boolean and returns a value accordingly.
clean = List.Clean(list=scopeIf, preserveIndices=code_block.out1)
scopeIf_2 = Custom[CW.ScopeIf+](VARtest=n02_false_delete_all_selected, VARtrue=filterByBoolMask.out, VARfalse=code_block.out0)
clean_2 = List.Clean(list=scopeIf_2, preserveIndices=code_block.out1)
create = List.Create(item0=clean, item1=clean_2)
flatten = List.Flatten(list=create)
scopeIf_3 = Custom[CW.ScopeIf+](VARtest=n03_proceed, VARtrue=flatten, VARfalse=code_block.out0)
clean_3 = List.Clean(list=scopeIf_3, preserveIndices=code_block.out1)
eraser = Custom[ST.Tool.Eraser](VARList=clean_3)  # package Synthesize toolkit; Try to delete any element from project
count = List.Count(list=flatten)
n01_number_of_materials_to_delete = Watch(count)  # "01.Number of Materials to Delete"; graph output
debug_python = Custom[Debug Python]()  # package Synthesize toolkit; Debug Python
