# Dynamo graph Materials.Restore Material Assets.dyn (Dynamo 2.13.1.3887)
# author: karam@aecedx.com
# packages: Synthesize toolkit 12.5.1

# group: Input
n01_materials_to_restore_leave = StringInput("")  # "01.Materials To Restore (Leave Empty To Resotre All) - (Separate By Symbol )"; graph input
n02_separation_symbol = StringInput(",")  # "02.Separation Symbol"; graph input
n03_drafting_view_name_restore = StringInput("Dynamo Materials Override Data")  # "03.Drafting View Name (Restore Data From)"; graph input
n04_remove_the_following_prefix = StringInput("OVERRIDDEN_")  # "04.Remove The Following Prefix If Found"; graph input

restore_material_assets = Custom[Restore Material Assets](VARMaterialsToRestore=n01_materials_to_restore_leave, VARSeparator=n02_separation_symbol, VARDraftingViewName=n03_drafting_view_name_restore, VARPrefix=n04_remove_the_following_prefix)  # package Synthesize toolkit; Restore Material Assets
debug_python_no_message = Custom[Debug Python No Message]()  # package Synthesize toolkit; Debug Python
