# Dynamo graph Opening.Inverted Vertical Opening.dyn (Dynamo 2.13.1.3887)
# author: karam@aecedx.com
# packages: Synthesize toolkit 12.5.1

# group: Input
n01_select_host = DSModelElementSelection()  # "01.Select Host"; nothing selected; graph input
n02_select_lines = DSModelElementsSelection()  # "02.Select Lines"; nothing selected; graph input
n03_fixer_slider_change_if_script = DoubleSlider(0.45, range=0..1 step 0.01)  # "03.Fixer Slider (Change If Script Failed)"; graph input

dynamo_and_revit_versions = Custom[Dynamo and Revit Versions]()  # package Synthesize toolkit; Dynamo and Revit Versions
code_block = CodeBlock { 2.10; }
eq = dynamo_and_revit_versions.VARdynamoVersion == code_block
boundingBox = Element.BoundingBox(element=n01_select_host)
toCuboid = BoundingBox.ToCuboid(boundingBox=boundingBox)
explode = Geometry.Explode(geometry=toCuboid)
filterByOrientation = Custom[CW.Surface.FilterByOrientation](VARsurfaces=explode)  # package Synthesize toolkit; Sorts surfaces in three lists based on their orientation (vertical, horizontal up & horizontal down) and also returns three corresponding lists of booleans.
perimeterCurves = Surface.PerimeterCurves(surface=filterByOrientation.VARhorizontalUp)
as_polycurve_bycurves = Custom[AS.[&] PolyCurve.ByCurves](VARcurves=perimeterCurves)  # package Synthesize toolkit; Create polycurves from an unordered list of curves.
code_block_2 = CodeBlock { 1; }
unit_types = UnitTypes("Length")
displayUnitType = Custom[CW.UnitType.DisplayUnitType](VARunitType=unit_types)  # package Synthesize toolkit; Retrieves the display unit type for a given unit type.
toDisplayUnit = Custom[CW.InternalUnit.ToDisplayUnit](VARval=code_block_2, VARdisplayUnitType=displayUnitType.VARdisplayUnitType)  # package Synthesize toolkit; Converts a value from Revit's internal unit to a given display unit
curve_offset_fixer = Custom[Curve.Offset Fixer](VARcurve=as_polycurve_bycurves.VARpolyCurve, VARdistance=toDisplayUnit)  # package Synthesize toolkit; Curve.Offset Fixer
flatten = List.Flatten(list=curve_offset_fixer)
byPatch = Surface.ByPatch(closedCurve=flatten)
firstItem = List.FirstItem(list=byPatch)
byJoinedSurfaces = PolySurface.ByJoinedSurfaces(surfaces=firstItem)
curves = Element.Curves(element=n02_select_lines)
flatten_2 = List.Flatten(list=curves)
as_polycurve_bycurves_2 = Custom[AS.[&] PolyCurve.ByCurves](VARcurves=flatten_2)
curves_2 = PolyCurve.Curves(polyCurve=as_polycurve_bycurves_2.VARpolyCurve)
explode_2 = Geometry.Explode(geometry=curves_2)
flatten_3 = List.Flatten(list=explode_2@@L3)
numberOfCurves = PolyCurve.NumberOfCurves(polyCurve=as_polycurve_bycurves_2.VARpolyCurve)
code_block_3 = CodeBlock { 1; }
eq_2 = numberOfCurves == code_block_3
filterByBoolMask = List.FilterByBoolMask(list=flatten_3, mask=eq_2)
as_polycurve_bycurves_3 = Custom[AS.[&] PolyCurve.ByCurves](VARcurves=filterByBoolMask.out)
mergeByBoolMask = Custom[SP.List.MergeByBoolMask](VARIn=filterByBoolMask.in, VAROut=as_polycurve_bycurves_3.VARpolyCurve, VARmask=eq_2)  # package Synthesize toolkit; Merge two lists by a boolean mask list. The true count in the mask should be the same as the length of the true list and vice versa for the false list.
flatten_4 = List.Flatten(list=mergeByBoolMask)
byPatch_2 = Surface.ByPatch(closedCurve=flatten_4)
pointAtParameter = Surface.PointAtParameter(surface=byPatch_2)
XYZ = Custom[LF.Point.XYZ](VARpoint=pointAtParameter)  # package Synthesize toolkit; Get the X, Y, and Z components of a Point
byOrigin = CoordinateSystem.ByOrigin(z=XYZ.VARZ)
startPoint = Curve.StartPoint(curve=flatten)
XYZ_2 = Custom[LF.Point.XYZ](VARpoint=startPoint)
byOrigin_2 = CoordinateSystem.ByOrigin(z=XYZ_2.VARZ)
matchLength = Custom[LF.List.MatchLength](VARlistLength=byOrigin, VARlist=byOrigin_2)  # package Synthesize toolkit; Cycle a list to match the length of the first list.
transform = Geometry.Transform(geometry=byPatch_2, fromCoordinateSystem=byOrigin, contextCoordinateSystem=matchLength)
as_polysurface_splitbytools = Custom[AS.[&] PolySurface.SplitByTools](VARpolySurface=byJoinedSurfaces, VARtools=transform)  # package Synthesize toolkit; Split a single polysurface with multiple tools.
explode_3 = Geometry.Explode(geometry=as_polysurface_splitbytools)
toNurbsSurface = Surface.ToNurbsSurface(surface=explode_3)
area = Surface.Area(surface=toNurbsSurface)
sum = Math.Sum(values=area)
maximumItem = List.MaximumItem(list=sum)
eq_3 = maximumItem == sum
filterByBoolMask_2 = List.FilterByBoolMask(list=as_polysurface_splitbytools, mask=eq_3)
boundingBox_2 = Element.BoundingBox(element=n01_select_host)
dimensions = Custom[ZK.BoundingBox.Dimensions](VARBoundingBox=boundingBox_2)  # package Synthesize toolkit; Input Bounding Box element to get its dimensions (Width, Length, Height). Setting Boolean switch to True rounds output values.
join = List.Join(list0=dimensions.VARWidth, list1=dimensions.VARLength)
maximumItem_2 = List.MaximumItem(list=join)
code_block_4 = CodeBlock(a=maximumItem_2) { a*50; }
extendStart = Curve.ExtendStart(distance=code_block_4)  # unwired: curve
extendEnd = Curve.ExtendEnd(distance=code_block_4)  # unwired: curve
compose = ComposeFunctions(func0=extendStart, func1=extendEnd)  # "Function.Compose"
pointAtParameter_2 = Curve.PointAtParameter(curve=flatten_4, param=n03_fixer_slider_change_if_script)
UVParameterAtPoint = Surface.UVParameterAtPoint(surface=firstItem, point=pointAtParameter_2)
byParameterLineOnSurface = Curve.ByParameterLineOnSurface(baseSurface=firstItem, startParams=UVParameterAtPoint, endParams=UVParameterAtPoint)
apply = ApplyFunction(func=compose, arg1=byParameterLineOnSurface)  # "Function.Apply"
as_polysurface_splitbytools_2 = Custom[AS.[&] PolySurface.SplitByTools](VARpolySurface=filterByBoolMask_2.in, VARtools=apply)
flatten_5 = List.Flatten(list=as_polysurface_splitbytools_2)
perimeterCurves_2 = Surface.PerimeterCurves(surface=flatten_5)
as_polycurve_bycurves_4 = Custom[AS.[&] PolyCurve.ByCurves](VARcurves=perimeterCurves_2)
flatten_6 = List.Flatten(list=as_polycurve_bycurves_4.VARpolyCurve)
curves_3 = PolyCurve.Curves(polyCurve=flatten_6)
empty = List.Empty()
scopeIf = Custom[CW.ScopeIf+](VARtest=eq, VARtrue=curves_3, VARfalse=empty)  # package Synthesize toolkit; A (hopefully) more robust implementation of ScopeIf. Tests a single boolean and returns a value accordingly.
curves_offset_to_revit = Custom[Curves Offset To Revit Compatibility](VARCurves=scopeIf)  # package Synthesize toolkit; Curves Offset To Revit Compatibility
scopeIf_2 = Custom[CW.ScopeIf+](VARtest=eq, VARtrue=curves_offset_to_revit.VARCurves, VARfalse=curves_3)
byCurves = Custom[SP.FloorOpening.ByCurves](VARhost=n01_select_host@L1, VARcurves=scopeIf_2)  # package Synthesize toolkit; Create hosted floor opeinngs through the input floors. The second input is a list of sub-lists of the boundary curves.
string_from_object = FromObject(obj=n01_select_host)
code_block_5 = CodeBlock { "ExtrusionRoof"; }
eq_4 = string_from_object == code_block_5
string = StringInput("""The selected Host is Roof By Extrusion.

You don't need to use this script for it.

Because Roof By Extrusion accepts Loops within Loops.

Simply Select the Roof, then click on Vertical command, and pick the opening outlines, then draw a loop around the Roof.""")
empty_2 = List.Empty()
scopeIf_3 = Custom[CW.ScopeIf+](VARtest=eq_4, VARtrue=string, VARfalse=empty_2)
alert_popup = Custom[Alert Popup](VARMessage=scopeIf_3)  # package Synthesize toolkit; Popup a message dialog in Revit
debug_python_no_message = Custom[Debug Python No Message]()  # package Synthesize toolkit; Debug Python
