# Dynamo graph Parameter.Copy Parameters By Eelement Type.dyn (Dynamo 2.13.1.3887)
# author: karam@aecedx.com
# packages: Synthesize toolkit 12.5.1

# group: Input
n05_is_type_parameter = BoolSelector(false)  # "05.Is Type Parameter ?"; graph input
n03_element_types_to_map_to = ElementTypes()  # "03.Element Types to Map To"; nothing selected; graph input
n04_map_to_parameter = StringInput("")  # "04.Map To Parameter"; graph input
n01_element_types_to_copy_from = ElementTypes()  # "01.Element Types to Copy From"; nothing selected; graph input
n02_copy_from_parameter = StringInput("Area")  # "02.Copy From Parameter"; graph input

all_elements_of_type = ElementsOfType(element_type=n03_element_types_to_map_to)
elementType = Element.ElementType(element=all_elements_of_type)
uniqueItems = List.UniqueItems(list=elementType)
scopeIf = Custom[CW.ScopeIf+](VARtest=n05_is_type_parameter, VARtrue=uniqueItems, VARfalse=all_elements_of_type)  # package Synthesize toolkit; A (hopefully) more robust implementation of ScopeIf. Tests a single boolean and returns a value accordingly.
all_elements_of_type_2 = ElementsOfType(element_type=n01_element_types_to_copy_from)
elementType_2 = Element.ElementType(element=all_elements_of_type_2)
uniqueItems_2 = List.UniqueItems(list=elementType_2)
scopeIf_2 = Custom[CW.ScopeIf+](VARtest=n05_is_type_parameter, VARtrue=uniqueItems_2, VARfalse=all_elements_of_type_2)
parameter_copy = Custom[Parameter Copy](VARElementsToMapTo=scopeIf, VARMapToParameter=n04_map_to_parameter, VARElementsToCopyFrom=scopeIf_2, VARCopyFromParameter=n02_copy_from_parameter)  # package Synthesize toolkit; Parameter Copy
count = List.Count(list=parameter_copy)

# group: Report
n01_number_of_elements_mapped = Watch(count)  # "01.Number of Elements Mapped"; graph output

debug_python_no_message = Custom[Debug Python No Message]()  # package Synthesize toolkit; Debug Python
