# Dynamo graph Parameter.Copy Parameters By Family and Type.dyn (Dynamo 2.13.1.3887)
# author: karam@aecedx.com
# packages: Synthesize toolkit 12.5.1

# group: Input
n10_is_type_parameter = BoolSelector(false)  # "10.Is Type Parameter ?"; graph input
n07_all_elements_of_family_name = BoolSelector(true)  # "07.All Elements of Family Name (All types) ?"; graph input
n06_family_names_separate_by = StringInput("Family")  # "06.Family Names (Separate By Comma , - or * To Select All Matching)"; graph input
n08_specific_type_names_separate = StringInput("Type")  # "08.Specific Type Names (Separate by Comma , )"; graph input
n01_elements_in_active_view_only = BoolSelector(false)  # "01.Elements In Active View Only ?"; graph input
n09_map_to_parameter = StringInput("")  # "09.Map To Parameter"; graph input
n03_all_elements_of_family_name = BoolSelector(true)  # "03.All Elements of Family Name (All types) ?"; graph input
n02_family_names_separate_by = StringInput("Family")  # "02.Family Names (Separate By Comma , - or * To Select All Matching)"; graph input
n04_specific_type_names_separate = StringInput("Type")  # "04.Specific Type Names (Separate by Comma , )"; graph input
n05_copy_from_parameter = StringInput("")  # "05.Copy From Parameter"; graph input

code_block = CodeBlock { ","; }
family_and_type_selector = Custom[Family and Type Selector](VARAllElementsofFamilyNameAlltypes=n07_all_elements_of_family_name, VARFamilyName=n06_family_names_separate_by, VARSpecificTypeNamesSeparatebySymbol=n08_specific_type_names_separate, VARSeparationSymbol=code_block, VAROnlyInActiveView=n01_elements_in_active_view_only)  # package Synthesize toolkit; Family and Type Selector
elementType = Element.ElementType(element=family_and_type_selector.VARElements)
uniqueItems = List.UniqueItems(list=elementType)
scopeIf = Custom[CW.ScopeIf+](VARtest=n10_is_type_parameter, VARtrue=uniqueItems, VARfalse=family_and_type_selector.VARElements)  # package Synthesize toolkit; A (hopefully) more robust implementation of ScopeIf. Tests a single boolean and returns a value accordingly.
family_and_type_selector_2 = Custom[Family and Type Selector](VARAllElementsofFamilyNameAlltypes=n03_all_elements_of_family_name, VARFamilyName=n02_family_names_separate_by, VARSpecificTypeNamesSeparatebySymbol=n04_specific_type_names_separate, VARSeparationSymbol=code_block, VAROnlyInActiveView=n01_elements_in_active_view_only)
elementType_2 = Element.ElementType(element=family_and_type_selector_2.VARElements)
uniqueItems_2 = List.UniqueItems(list=elementType_2)
scopeIf_2 = Custom[CW.ScopeIf+](VARtest=n10_is_type_parameter, VARtrue=uniqueItems_2, VARfalse=family_and_type_selector_2.VARElements)
parameter_copy = Custom[Parameter Copy](VARElementsToMapTo=scopeIf, VARMapToParameter=n09_map_to_parameter, VARElementsToCopyFrom=scopeIf_2, VARCopyFromParameter=n05_copy_from_parameter)  # package Synthesize toolkit; Parameter Copy
count = List.Count(list=parameter_copy)

# group: Report
n01_number_of_elements_mapped = Watch(count)  # "01.Number of Elements Mapped"; graph output

debug_python_no_message = Custom[Debug Python No Message]()  # package Synthesize toolkit; Debug Python
