# Dynamo graph Parameter.Depth Extend Into Topography By Selection Filter.dyn (Dynamo 2.13.1.3887)
# author: karam@aecedx.com
# packages: Synthesize toolkit 12.5.1

# group: Credits
# note: Copyright (c) 2015, AECOM
# Written by: Matthew Anderle & Guy Mazzotta
# Fixed and Enhanced by : Karam Baki

hot_get_all_filter = Custom[HOT.Get All Filter]()  # package Synthesize toolkit; Get all Filter
toLower = String.ToLower(string=hot_get_all_filter.VARName)
trimWhitespace = String.TrimWhitespace(string=toLower)
n01_selection_filter_to_read = StringInput("Elements to Extend Into Topography")  # "01.Selection Filter to Read"; graph input
toLower_2 = String.ToLower(string=n01_selection_filter_to_read)
trimWhitespace_2 = String.TrimWhitespace(string=toLower_2)
eq = trimWhitespace == trimWhitespace_2
filterByBoolMask = List.FilterByBoolMask(list=hot_get_all_filter.VARElement, mask=eq)
elements = Custom[CW.SelectionSet.Elements](VARselectionSet=filterByBoolMask.in)  # package Synthesize toolkit; Retrieves all elements stored in a selection set
flatten = List.Flatten(list=elements)

# group: Input
n04_depth_parameter = StringInput("Base Offset")  # "04.Depth Parameter"; graph input
is_minus_1 = BoolSelector(true)
n02_select_revit_topography = DSModelElementSelection()  # "02.Select Revit Topography"; nothing selected; graph input
n05_extra_depth_can_be_0 = DoubleInput(0)  # "05.Extra Depth (Can be 0)"; graph input
n03_level_parameter_name = StringInput("Base Level")  # "03.Level Parameter Name"; graph input

add = _ + _  # unwired: x, y
location = Custom[CW.Element.Location](VARelement=flatten)  # package Synthesize toolkit; Returns the location of an element as an XYZ (or if it's line-based the start and end point of the line), along with some booleans to help filtering the results. Use this for some element types (e.g. walls or lines) that do not work with the built-in Get Family Instance Location node.
Z = Point.Z(point=location.VARpoints)
getParameterValueByName = Element.GetParameterValueByName(element=flatten, parameterName=n04_depth_parameter)
subtract_returns_elevation_of = Z - getParameterValueByName  # "(subtract) Returns Elevation of Caisson at T/ Socket"
X = Point.X(point=location.VARpoints)
Y = Point.Y(point=location.VARpoints)
convert_topo_to_polysurface = CodeBlock(T=n02_select_revit_topography, x=X, y=Y)
# ---------- convert_topo_to_polysurface.designscript (8 lines) ----------
iA=List.GetItemAtIndex(T.Mesh.VertexPositions,T.Mesh.FaceIndices.A);
iB=List.GetItemAtIndex(T.Mesh.VertexPositions,T.Mesh.FaceIndices.B);
iC=List.GetItemAtIndex(T.Mesh.VertexPositions,T.Mesh.FaceIndices.C);
TopoSurf=PolySurface.ByJoinedSurfaces(Surface.ByPerimeterPoints(List.Transpose([iA,iB,iC])));

z=(TopoSurf.BoundingBox.MinPoint.Z)-10;
Point.ByCoordinates(x,y,z);
dir=Vector.ZAxis();
# ----------------------------------------
project = Point.Project(point=convert_topo_to_polysurface.out5, baseGeometry=convert_topo_to_polysurface.TopoSurf, projectionDirection=convert_topo_to_polysurface.dir)
Z_2 = Point.Z(point=project)
flatten_2 = List.Flatten(list=Z_2)
sub = subtract_returns_elevation_of - flatten_2
combine = List.Combine(comb=add, list1=sub, list2=getParameterValueByName)
add_2 = combine + n05_extra_depth_can_be_0
getParameterValueByName_2 = Element.GetParameterValueByName(element=flatten, parameterName=n03_level_parameter_name)
projectElevation = Level.ProjectElevation(level=getParameterValueByName_2)
add_3 = add_2 + projectElevation
code_block = CodeBlock { -1; }
mul = add_3 * code_block
scopeIf = Custom[CW.ScopeIf+](VARtest=is_minus_1, VARtrue=mul, VARfalse=add_3)  # package Synthesize toolkit; A (hopefully) more robust implementation of ScopeIf. Tests a single boolean and returns a value accordingly.
setParameterByName = Element.SetParameterByName(element=flatten, parameterName=n04_depth_parameter, value=scopeIf)
count = List.Count(list=setParameterByName)

# group: Report
n01_number_of_extended_elements = Watch(count)  # "01.Number of Extended Elements"; graph output
n02_values_used = Watch(scopeIf)  # "02.Values Used"; graph output

debug_python = Custom[Debug Python]()  # package Synthesize toolkit; Debug Python
