# Dynamo graph Parameter.Flip By Selection Filter.dyn (Dynamo 2.13.1.3887)
# author: karam@aecedx.com
# packages: Synthesize toolkit 12.5.1

hot_get_all_filter = Custom[HOT.Get All Filter]()  # package Synthesize toolkit; Get all Filter
toLower = String.ToLower(string=hot_get_all_filter.VARName)
trimWhitespace = String.TrimWhitespace(string=toLower)

# group: Input
n01_selection_filter_to_read = StringInput("Fitler Name")  # "01.Selection Filter to Read"; graph input
n03_name_of_parameters_to_flip = StringInput("Height")  # "03.Name of Parameters to Flip (Separate By Comma , or - * To Select All Matching)"; graph input
n02_is_type_parameter = BoolSelector(false)  # "02.Is Type Parameter ?"; graph input
n04_proceed = BoolSelector(false)  # "04.Proceed ?"; graph input

toLower_2 = String.ToLower(string=n01_selection_filter_to_read)
trimWhitespace_2 = String.TrimWhitespace(string=toLower_2)
eq = trimWhitespace == trimWhitespace_2
filterByBoolMask = List.FilterByBoolMask(list=hot_get_all_filter.VARElement, mask=eq)
elements = Custom[CW.SelectionSet.Elements](VARselectionSet=filterByBoolMask.in)  # package Synthesize toolkit; Retrieves all elements stored in a selection set
flatten = List.Flatten(list=elements)
code_block = CodeBlock { ","; }
parameters_selector = Custom[Parameters Selector](VARElements=flatten, VARParameterNames=n03_name_of_parameters_to_flip, VARSeparationSymbol=code_block, VARIsTypeParam=n02_is_type_parameter)  # package Synthesize toolkit; Parameters Selector
flip_parameter_values = Custom[Flip Parameter Values](VARListofParameterstoFlip=parameters_selector, VARProceed=n04_proceed, VARElementstoWorkon=flatten, VARIsTypeParameters=n02_is_type_parameter)  # package Synthesize toolkit; Flip Parameter Values

# group: Report
n01_elements_to_select = Watch(flip_parameter_values.VARElementstoselect)  # "01.Elements to select"; graph output
n02_number_of_elements = Watch(flip_parameter_values.VARNumberofElements)  # "02.Number of Elements"; graph output

debug_python = Custom[Debug Python]()  # package Synthesize toolkit; Debug Python
