# Dynamo graph Parameter.K-Attractor By All Elements of Active View.dyn (Dynamo 2.13.1.3887)
# author: karam@aecedx.com
# packages: Synthesize toolkit 12.5.1

python_all_elements_in_active = Custom[Python All Elements In Active View]()  # package Synthesize toolkit; Python All Elements In Active View

# group: Input
n01_select_attractors = DSModelElementsSelection()  # "01.Select Attractors"; nothing selected; graph input
n06_repeated_sequence_for_all = BoolSelector(true)  # "06.Repeated Sequence for All Parameters ?"; graph input
n05_reverse_numbers = BoolSelector(false)  # "05.Reverse Numbers ?"; graph input
n03_start_number = DoubleInput(1)  # "03.Start Number"; graph input
n04_sequence_steps = DoubleInput(0.1)  # "04.Sequence Steps"; graph input
normalize = BoolSelector(false)  # "07.Normalize"; graph input
n08_new_minimum_normalize_true = DoubleInput(0)  # "08.New Minimum (Normalize = True)"; graph input
n09_new_maximum_normalize_true = DoubleInput(1)  # "09.New Maximum (Normalize = True)"; graph input
n17_proceed = BoolSelector(false)  # "17.Proceed ?"; graph input
rounding = DoubleInput(0.01)  # "10.Rounding"; graph input
n11_additive = BoolSelector(false)  # "11.Additive ?"; graph input
n02_name_of_parameters_to_attract = StringInput("Height")  # "02.Name of Parameters to Attract (Separate By Comma ,)"; graph input
n12_circle_preview_will_draw = BoolSelector(false)  # "12.Circle Preview (Will Draw Indicative Circles)"; graph input
n13_minimum_preview_circle_radius = DoubleInput(1)  # "13.Minimum Preview Circle Radius"; graph input
n14_maximum_preview_circle_radius = DoubleInput(5)  # "14.Maximum Preview Circle Radius"; graph input
n15_circles_perview_degree = DoubleInput(0)  # "15.Circles Perview Degree"; graph input
n16_circles_preview_plane_x_false = BoolSelector(false)  # "16.Circles Preview Plane (X=False | Y=True)"; graph input

removeListFromList = Custom[RH.RemoveListFromList](VARListA=python_all_elements_in_active, VARListB=n01_select_attractors)  # package Synthesize toolkit; This node essentially "subtracts" the contents of List B from List A to produce a new list with the unique items.
code_block = CodeBlock { ","; }
parameters_selector = Custom[Parameters Selector](VARElements=removeListFromList, VARParameterNames=n02_name_of_parameters_to_attract, VARSeparationSymbol=code_block)  # package Synthesize toolkit; Parameters Selector
k_attractor_for_parameters = Custom[K-Attractor For Parameters](VARElementstoWorkon=removeListFromList, VARAttractors=n01_select_attractors, VARRepeatedSequenceforAllParameters=n06_repeated_sequence_for_all, VARReverseNumbers=n05_reverse_numbers, VARStartNumber=n03_start_number, VARSequenceSteps=n04_sequence_steps, VARNormalize=normalize, VARNewMinimumNormalize=n08_new_minimum_normalize_true, VARNewMaximumNormalize=n09_new_maximum_normalize_true, VARProceed=n17_proceed, VARRounding=rounding, VARAdditive=n11_additive, VARListofParameterstoAttract=parameters_selector)  # package Synthesize toolkit; K-Attractor By Selection

# group: Report
n01_values_generated = Watch(k_attractor_for_parameters.VARValuesGenerated)  # "01.Values Generated"; graph output
n02_number_of_unique_elements = Watch(k_attractor_for_parameters.VARNumberofUniqueElements)  # "02.Number of Unique Elements"; graph output
n03_number_of_repeated_elements = Watch(k_attractor_for_parameters.VARNumberofRepeatedElements)  # "03.Number of Repeated Elements"; graph output
n04_number_of_total_elements = Watch(k_attractor_for_parameters.VARNumberofTotalElements)  # "04.Number of Total Elements"; graph output
n05_elements_to_select = Watch(k_attractor_for_parameters.VARElementstoselect)  # "05.Elements to select"; graph output

k_attractor_circles_preview = Custom[K-Attractor Circles Preview](VARCirclePreview=n12_circle_preview_will_draw, VARLocations=k_attractor_for_parameters.VARLocations, VARValuesGenerated=k_attractor_for_parameters.VARValuesGenerated, VARMinimumPreviewCircleRadius=n13_minimum_preview_circle_radius, VARMaximumPreviewCircleRadius=n14_maximum_preview_circle_radius, VARCirclesPreviewDegree=n15_circles_perview_degree, VARCirclesPreviewPlaneX=n16_circles_preview_plane_x_false)  # package Synthesize toolkit; Preview Node for K-Attractor
debug_python = Custom[Debug Python]()  # package Synthesize toolkit; Debug Python
