# Dynamo graph Parameter.K-Attractor Image By Divided Surface Families.dyn (Dynamo 2.13.1.3887)
# author: karam@aecedx.com
# packages: Synthesize toolkit 12.5.1

# group: Input
n01_select_divided_surface = DSDividedSurfaceFamiliesSelection()  # "01.Select Divided Surface Families"; nothing selected; graph input
parameter = StringInput("Height")  # "06.Parameter"; graph input
n05_flip_image = BoolSelector(false)  # "05.Flip Image"; graph input
n02_image_file = Filename(".\Image.png")  # "02.Image File"; graph input
n04_number_of_units_in_row_test = DoubleInput(10)  # "04.Number of Units in Row (Test Both Rows)"; graph input
multiplier = DoubleInput(1)  # "03.Multiplier"; graph input
n07_minimum_value = DoubleInput(1)  # "07.Minimum Value"; graph input
n08_maximum_value = DoubleInput(5)  # "08.Maximum Value"; graph input

code_block = CodeBlock { 0; 1; }
fromPath = FileObject(path=n02_image_file)  # "File.FromPath"
readFromFile = Image.ReadFromFile(file=fromPath)
chop = List.Chop(list=n01_select_divided_surface, lengths=n04_number_of_units_in_row_test)
count = List.Count(list=chop@L2)
firstItem = List.FirstItem(list=count)
count_2 = List.Count(list=chop)
pixels = Image.Pixels(image=readFromFile, xSamples=firstItem, ySamples=count_2)
brightness = Color.Brightness(color=pixels)
code_block_2 = CodeBlock(a=brightness, b=multiplier) { a*b; }
mapTo = Math.MapTo(rangeMin=code_block.out0, rangeMax=code_block.out1, inputValue=code_block_2, targetRangeMin=n07_minimum_value, targetRangeMax=n08_maximum_value)
flatten = List.Flatten(list=mapTo)
reverse = List.Reverse(list=flatten)
scopeIf = Custom[CW.ScopeIf+](VARtest=n05_flip_image, VARtrue=reverse, VARfalse=flatten)  # package Synthesize toolkit; A (hopefully) more robust implementation of ScopeIf. Tests a single boolean and returns a value accordingly.
setParameterByName = Element.SetParameterByName(element=n01_select_divided_surface, parameterName=parameter, value=scopeIf)
debug_python = Custom[Debug Python]()  # package Synthesize toolkit; Debug Python
