# Dynamo graph Parameter.K-Attractor Image By Selection Filter.dyn (Dynamo 2.13.1.3887)
# author: karam@aecedx.com
# packages: Synthesize toolkit 12.5.1

hot_get_all_filter = Custom[HOT.Get All Filter]()  # package Synthesize toolkit; Get all Filter
toLower = String.ToLower(string=hot_get_all_filter.VARName)
trimWhitespace = String.TrimWhitespace(string=toLower)

# group: Input
n01_selection_filter_to_read = StringInput("Fitler Name")  # "01.Selection Filter to Read"; graph input
parameter = StringInput("Height")  # "06.Parameter"; graph input
n05_flip_image = BoolSelector(false)  # "05.Flip Image"; graph input
n02_image_file = Filename(".\Image.png")  # "02.Image File"; graph input
n04_number_of_units_in_row_test = DoubleInput(10)  # "04.Number of Units in Row (Test Both Rows)"; graph input
multiplier = DoubleInput(1)  # "03.Multiplier"; graph input
n07_minimum_value = DoubleInput(1)  # "07.Minimum Value"; graph input
n08_maximum_value = DoubleInput(5)  # "08.Maximum Value"; graph input

toLower_2 = String.ToLower(string=n01_selection_filter_to_read)
trimWhitespace_2 = String.TrimWhitespace(string=toLower_2)
eq = trimWhitespace == trimWhitespace_2
filterByBoolMask = List.FilterByBoolMask(list=hot_get_all_filter.VARElement, mask=eq)
elements = Custom[CW.SelectionSet.Elements](VARselectionSet=filterByBoolMask.in)  # package Synthesize toolkit; Retrieves all elements stored in a selection set
flatten = List.Flatten(list=elements)
code_block = CodeBlock { 0; 1; }
fromPath = FileObject(path=n02_image_file)  # "File.FromPath"
readFromFile = Image.ReadFromFile(file=fromPath)
chop = List.Chop(list=flatten, lengths=n04_number_of_units_in_row_test)
count = List.Count(list=chop@L2)
firstItem = List.FirstItem(list=count)
count_2 = List.Count(list=chop)
pixels = Image.Pixels(image=readFromFile, xSamples=firstItem, ySamples=count_2)
brightness = Color.Brightness(color=pixels)
code_block_2 = CodeBlock(a=brightness, b=multiplier) { a*b; }
mapTo = Math.MapTo(rangeMin=code_block.out0, rangeMax=code_block.out1, inputValue=code_block_2, targetRangeMin=n07_minimum_value, targetRangeMax=n08_maximum_value)
flatten_2 = List.Flatten(list=mapTo)
reverse = List.Reverse(list=flatten_2)
scopeIf = Custom[CW.ScopeIf+](VARtest=n05_flip_image, VARtrue=reverse, VARfalse=flatten_2)  # package Synthesize toolkit; A (hopefully) more robust implementation of ScopeIf. Tests a single boolean and returns a value accordingly.
setParameterByName = Element.SetParameterByName(element=flatten, parameterName=parameter, value=scopeIf)
debug_python = Custom[Debug Python]()  # package Synthesize toolkit; Debug Python
