# Dynamo graph Parameter.K-Attractor Material By Selection Filter.dyn (Dynamo 2.13.1.3887)
# author: karam@aecedx.com
# packages: Synthesize toolkit 12.5.1

# group: Input
n02_select_attractors = DSModelElementsSelection()  # "02.Select Attractors"; nothing selected; graph input
n08_reverse_materials = BoolSelector(false)  # "08.Reverse Materials ?"; graph input
n06_balanced_rhythm_seed = BoolSelector(true)  # "06.Balanced Rhythm (Seed) ?"; graph input
n07_custom_seed_value = DoubleInput(0)  # "07.Custom Seed Value"; graph input
n09_proceed = BoolSelector(false)  # "09.Proceed ?"; graph input
n01_selection_filter_to_read = StringInput("Fitler Name")  # "01.Selection Filter to Read"; graph input
n03_materials_to_attract_seperate = StringInput("Cherry, Glass, Aluminum")  # "03.Materials to Attract (Seperate by Symbol)"; graph input
n04_separation_symbol = StringInput(",")  # "04.Separation Symbol"; graph input
n05_name_of_material_parameters = StringInput("Material")  # "05.Name of Material Parameters to Attract (Separate By Comma , or - * To Select All Matching)"; graph input

python_all_elements_in_active = Custom[Python All Elements In Active View]()  # package Synthesize toolkit; Python All Elements In Active View
hot_get_all_filter = Custom[HOT.Get All Filter]()  # package Synthesize toolkit; Get all Filter
toLower = String.ToLower(string=hot_get_all_filter.VARName)
trimWhitespace = String.TrimWhitespace(string=toLower)
toLower_2 = String.ToLower(string=n01_selection_filter_to_read)
trimWhitespace_2 = String.TrimWhitespace(string=toLower_2)
eq = trimWhitespace == trimWhitespace_2
filterByBoolMask = List.FilterByBoolMask(list=hot_get_all_filter.VARElement, mask=eq)
elements = Custom[CW.SelectionSet.Elements](VARselectionSet=filterByBoolMask.in)  # package Synthesize toolkit; Retrieves all elements stored in a selection set
flatten = List.Flatten(list=elements)
code_block = CodeBlock { ","; }
parameters_selector = Custom[Parameters Selector](VARElements=flatten, VARParameterNames=n05_name_of_material_parameters, VARSeparationSymbol=code_block)  # package Synthesize toolkit; Parameters Selector
k_attractor_for_materials = Custom[K-Attractor For Materials](VARAttractors=n02_select_attractors, VARReverseMaterials=n08_reverse_materials, VARBalancedRhythmSeed=n06_balanced_rhythm_seed, VARCustomSeedValue=n07_custom_seed_value, VARProceed=n09_proceed, VARAllElementsInActiveView=python_all_elements_in_active, VARElementstoWorkon=flatten, VARMaterialstoAttract=n03_materials_to_attract_seperate, VARSeperationSymbol=n04_separation_symbol, VARMaterialParameters=parameters_selector)  # package Synthesize toolkit; K-Attractor For Family Types
name = Material.Name(material=k_attractor_for_materials.VARMaterialsOrdertoUse)

# group: Result
n01_balanced_seed_value = Watch(k_attractor_for_materials.VARBalancedSeedValue)  # "01.Balanced Seed Value"; graph output
n02_number_of_total_elements = Watch(k_attractor_for_materials.VARNumberofTotalElements)  # "02.Number of Total Elements"; graph output
n03_materials_order_to_use = Watch(name)  # "03.Materials Order to Use"; graph output
n04_elements_to_select = Watch(k_attractor_for_materials.VARElementstoselect)  # "04.Elements to select"; graph output

debug_python = Custom[Debug Python]()  # package Synthesize toolkit; Debug Python
