# Dynamo graph Parameter.K-Change By All Elements of Active View.dyn (Dynamo 2.13.1.3887)
# author: karam@aecedx.com
# packages: Synthesize toolkit 12.5.1

# group: Input
n03_parameter_s_value_to_set_text = StringInput("Karam")  # "03.Parameter(s) Value To Set (Text, Number, Material, Level...etc) - Separate By Symbol"; graph input
n04_separation_symbol = StringInput(",")  # "04.Separation Symbol"; graph input
n01_parameter_s_to_change_text = StringInput("Comments")  # "01.Parameter(s) To Change (Text, Number, Material, Level...etc) - Separate By Symbol - * To Select All Matching"; graph input
n02_is_type_parameter_s = BoolSelector(false)  # "02.Is Type Parameter(s)"; graph input
n05_fetch_groups_elements_might = BoolSelector(false)  # "05.Fetch Groups Elements (Might Help For Strange Behaviours Like Stairs)"; graph input

split = String.Split(string=n03_parameter_s_value_to_set_text, separator0=n04_separation_symbol)
split_2 = String.Split(string=n01_parameter_s_to_change_text, separator0=n04_separation_symbol)
python_all_elements_in_active = Custom[Python All Elements In Active View]()  # package Synthesize toolkit; Python All Elements In Active View
flatten = List.Flatten(list=python_all_elements_in_active)
recurring_group_elements_fetch = Custom[Recurring Group Elements Fetch](VARElements=flatten, VARFetch=n05_fetch_groups_elements_might)  # package Synthesize toolkit; Recurring Group Elements Fetch
advanced_elements_filter = Custom[Advanced Elements Filter](VARIsTypeParameter=n02_is_type_parameter_s, VARParametersList=split_2, VARElements=recurring_group_elements_fetch)  # package Synthesize toolkit; Advanced Elements Filter
advanced_parameter_set_with = Custom[Advanced Parameter Set With Translate](VARParameterValueToSet=split@L1, VARParameterToChange=split_2@L1, VARParameters=advanced_elements_filter.VARParameter, VARIsType=n02_is_type_parameter_s, VARElements=advanced_elements_filter.VARElements, VARParameterNames=advanced_elements_filter.VARParameterNames)  # package Synthesize toolkit; Advanced Parameter Set With Translate

# group: Report
n01_number_of_effected_elements = Watch(advanced_parameter_set_with)  # "01.Number of Effected Elements"; graph output

debug_python_no_message = Custom[Debug Python No Message]()  # package Synthesize toolkit; Debug Python
