# Dynamo graph Parameter.K-Change By Family and Type.dyn (Dynamo 2.13.1.3887)
# author: karam@aecedx.com
# packages: Synthesize toolkit 12.5.1

# group: Input
n07_parameter_s_value_to_set_text = StringInput("Karam")  # "07.Parameter(s) Value To Set (Text, Number, Material, Level...etc) - Separate By Symbol"; graph input
n08_separation_symbol = StringInput(",")  # "08.Separation Symbol"; graph input
n05_parameter_s_to_change_text = StringInput("Comments")  # "05.Parameter(s) To Change (Text, Number, Material, Level...etc) - Separate By Symbol - * To Select All Matching"; graph input
n06_is_type_parameter_s = BoolSelector(false)  # "06.Is Type Parameter(s)"; graph input
n02_all_elements_of_family_name = BoolSelector(true)  # "02.All Elements of Family Name (All types) ?"; graph input
n01_family_names_separate_by = StringInput("Family")  # "01.Family Names (Separate By Comma , - or * To Select All Matching)"; graph input
n03_specific_type_names_separate = StringInput("Type")  # "03.Specific Type Names (Separate by Comma , )"; graph input
n04_elements_in_active_view_only = BoolSelector(false)  # "04.Elements In Active View Only ?"; graph input
n09_fetch_groups_elements_might = BoolSelector(false)  # "09.Fetch Groups Elements (Might Help For Strange Behaviours Like Stairs)"; graph input

split = String.Split(string=n07_parameter_s_value_to_set_text, separator0=n08_separation_symbol)
split_2 = String.Split(string=n05_parameter_s_to_change_text, separator0=n08_separation_symbol)
code_block = CodeBlock { ","; }
family_and_type_selector = Custom[Family and Type Selector](VARAllElementsofFamilyNameAlltypes=n02_all_elements_of_family_name, VARFamilyName=n01_family_names_separate_by, VARSpecificTypeNamesSeparatebySymbol=n03_specific_type_names_separate, VARSeparationSymbol=code_block, VAROnlyInActiveView=n04_elements_in_active_view_only)  # package Synthesize toolkit; Family and Type Selector
flatten = List.Flatten(list=family_and_type_selector.VARElements)
recurring_group_elements_fetch = Custom[Recurring Group Elements Fetch](VARElements=flatten, VARFetch=n09_fetch_groups_elements_might)  # package Synthesize toolkit; Recurring Group Elements Fetch
advanced_elements_filter = Custom[Advanced Elements Filter](VARIsTypeParameter=n06_is_type_parameter_s, VARParametersList=split_2, VARElements=recurring_group_elements_fetch)  # package Synthesize toolkit; Advanced Elements Filter
advanced_parameter_set_with = Custom[Advanced Parameter Set With Translate](VARParameterValueToSet=split@L1, VARParameterToChange=split_2@L1, VARParameters=advanced_elements_filter.VARParameter, VARIsType=n06_is_type_parameter_s, VARElements=advanced_elements_filter.VARElements, VARParameterNames=advanced_elements_filter.VARParameterNames)  # package Synthesize toolkit; Advanced Parameter Set With Translate

# group: Report
n01_number_of_effected_elements = Watch(advanced_parameter_set_with)  # "01.Number of Effected Elements"; graph output

debug_python_no_message = Custom[Debug Python No Message]()  # package Synthesize toolkit; Debug Python
