# Dynamo graph Parameter.Randomize By All Elements of Active View.dyn (Dynamo 2.13.1.3887)
# author: karam@aecedx.com
# packages: Synthesize toolkit 12.5.1

debug_python = Custom[Debug Python]()  # package Synthesize toolkit; Debug Python

# group: Input
n07_additive = BoolSelector(false)  # "07.Additive ?"; graph input
rounding = DoubleInput(0.01)  # "06.Rounding"; graph input
n08_proceed = BoolSelector(false)  # "08.Proceed ?"; graph input
n05_integer_numbers_of = BoolSelector(false)  # "05.Integer numbers of Randomizing ?"; graph input
n03_minimum_value = DoubleInput(5)  # "03.Minimum Value"; graph input
n04_maximum_value = DoubleInput(12)  # "04.Maximum Value"; graph input
n02_name_of_parameters_to = StringInput("Height")  # "02.Name of Parameters to Randomize (Separate By Comma , or - * To Select All Matching)"; graph input
n01_is_type_parameter = BoolSelector(false)  # "01.Is Type Parameter ?"; graph input

python_all_elements_in_active = Custom[Python All Elements In Active View]()  # package Synthesize toolkit; Python All Elements In Active View
code_block = CodeBlock { ","; }
parameters_selector = Custom[Parameters Selector](VARElements=python_all_elements_in_active, VARParameterNames=n02_name_of_parameters_to, VARSeparationSymbol=code_block, VARIsTypeParam=n01_is_type_parameter)  # package Synthesize toolkit; Parameters Selector
randomize_parameters = Custom[Randomize Parameters](VARAdditive=n07_additive, VARRounding=rounding, VARProceed=n08_proceed, VARIntegernumbersofRandomizing=n05_integer_numbers_of, VARMinimumValue=n03_minimum_value, VARMaximumValue=n04_maximum_value, VARListofParameterstoRandomize=parameters_selector, VARElementstoWorkon=python_all_elements_in_active, VARIsTypeParameters=n01_is_type_parameter)  # package Synthesize toolkit; Randomize Parameters

# group: Report
n02_values_generated = Watch(randomize_parameters)  # "02.Values Generated"; graph output

count = List.Count(list=n02_values_generated)

# group (continued): Report
n01_number_of_elements = Watch(count)  # "01.Number of Elements"; graph output
