# Dynamo graph Parameter.Randomize By Selection.dyn (Dynamo 2.13.1.3887)
# author: karam@aecedx.com
# packages: Synthesize toolkit 12.5.1

# group: Input
n08_additive = BoolSelector(false)  # "08.Additive ?"; graph input
rounding = DoubleInput(0.01)  # "07.Rounding"; graph input
n09_proceed = BoolSelector(false)  # "09.Proceed ?"; graph input
n06_integer_numbers_of = BoolSelector(false)  # "06.Integer numbers of Randomizing ?"; graph input
n04_minimum_value = DoubleInput(5)  # "04.Minimum Value"; graph input
n05_maximum_value = DoubleInput(12)  # "05.Maximum Value"; graph input
n01_select_elements_to_work_on = DSModelElementsSelection()  # "01.Select Elements to Work on"; nothing selected; graph input
n03_name_of_parameters_to = StringInput("Height")  # "03.Name of Parameters to Randomize (Separate By Comma , - or * To Select All Matching)"; graph input
n02_is_type_parameter = BoolSelector(false)  # "02.Is Type Parameter ?"; graph input

code_block = CodeBlock { ","; }
parameters_selector = Custom[Parameters Selector](VARElements=n01_select_elements_to_work_on, VARParameterNames=n03_name_of_parameters_to, VARSeparationSymbol=code_block, VARIsTypeParam=n02_is_type_parameter)  # package Synthesize toolkit; Parameters Selector
randomize_parameters = Custom[Randomize Parameters](VARAdditive=n08_additive, VARRounding=rounding, VARProceed=n09_proceed, VARIntegernumbersofRandomizing=n06_integer_numbers_of, VARMinimumValue=n04_minimum_value, VARMaximumValue=n05_maximum_value, VARListofParameterstoRandomize=parameters_selector, VARElementstoWorkon=n01_select_elements_to_work_on, VARIsTypeParameters=n02_is_type_parameter)  # package Synthesize toolkit; Randomize Parameters

# group: Report
n02_values_generated = Watch(randomize_parameters)  # "02.Values Generated"; graph output

count = List.Count(list=n02_values_generated)

# group (continued): Report
n01_number_of_elements = Watch(count)  # "01.Number of Elements"; graph output

debug_python = Custom[Debug Python]()  # package Synthesize toolkit; Debug Python
