# Dynamo graph Parameter.Randomize Family Parameters.dyn (Dynamo 2.13.1.3887)
# author: karam@aecedx.com
# packages: Synthesize toolkit 12.5.1

# group: Input
n05_integer_numbers_of = BoolSelector(false)  # "05.Integer numbers of Randomizing ?"; graph input
n06_additive = BoolSelector(false)  # "06.Additive ?"; graph input
n02_minimum_value = DoubleInput(1)  # "02.Minimum Value"; graph input
n03_maximum_value = DoubleInput(15)  # "03.Maximum Value"; graph input
rounding = DoubleInput(0.01)  # "04.Rounding"; graph input
n01_name_of_parameters_to = StringInput("U Num")  # "01.Name of Parameters to Randomize (Separate By Comma , - or * To Select All Matching)"; graph input

familyParameters = Custom[CW.FamilyDocument.FamilyParameters]()  # package Synthesize toolkit; Retrieves all family parameters from the active family document. PLEASE NOTE: This node will only work in a family document!
properties = Custom[CW.FamilyParameter.Properties](VARfamilyParameter=familyParameters)  # package Synthesize toolkit; Retrieves all properties of a given family parameter. PLEASE NOTE: This node will only work in a family document!
python_empty_2_null = Custom[Python Empty 2 Null](VARIN=properties.VARAssociatedParameters)  # package Synthesize toolkit; Python Null 2 Empty
code_block = CodeBlock { "*"; ""; }
contains = String.Contains(string=n01_name_of_parameters_to, searchFor=code_block.out0)
empty = List.Empty()
scopeIf = Custom[CW.ScopeIf+](VARtest=contains, VARtrue=n01_name_of_parameters_to, VARfalse=empty)  # package Synthesize toolkit; A (hopefully) more robust implementation of ScopeIf. Tests a single boolean and returns a value accordingly.
replace = String.Replace(string=scopeIf, searchFor=code_block.out0, replaceWith=code_block.out1)
contains_2 = String.Contains(string=properties.VARName, searchFor=replace)
filterByBoolMask = List.FilterByBoolMask(list=properties.VARName, mask=contains_2)
flatten = List.Flatten(list=filterByBoolMask.in)
uniqueItems = List.UniqueItems(list=flatten)
scopeIf_2 = Custom[CW.ScopeIf+](VARtest=contains, VARtrue=empty, VARfalse=n01_name_of_parameters_to)
code_block_2 = CodeBlock { ","; }
split = String.Split(string=scopeIf_2, separator0=code_block_2)
trimWhitespace = String.TrimWhitespace(string=split)
scopeIf_3 = Custom[CW.ScopeIf+](VARtest=contains, VARtrue=uniqueItems, VARfalse=trimWhitespace)
family_parameters_randomize = Custom[Family Parameters Randomize](VARIntegernumbersofRandomizing=n05_integer_numbers_of, VARAdditive=n06_additive, VARMinimumValue=n02_minimum_value, VARMaximumValue=n03_maximum_value, VARRounding=rounding, VARfamilyParameters=familyParameters, VARAssociatedParameters=python_empty_2_null, VARNameofFamilyParameter=properties.VARName, VARListofParameterstoRandomize=scopeIf_3)  # package Synthesize toolkit; Family Parameters Randomize

# group: Report
n01_number_of_associated_elements = Watch(family_parameters_randomize.VARNumberofAssociatedElements)  # "01.Number of Associated Elements"; graph output
n02_values_generated = Watch(family_parameters_randomize.VARValuesGenerated)  # "02.Values Generated"; graph output

debug_python = Custom[Debug Python]()  # package Synthesize toolkit; Debug Python
