# Dynamo graph Parameter.Randomize Material By Family and Type.dyn (Dynamo 2.13.1.3887)
# author: karam@aecedx.com
# packages: Synthesize toolkit 12.5.1

# group: Input
n02_all_elements_of_family_name = BoolSelector(true)  # "02.All Elements of Family Name (All types) ?"; graph input
n01_family_names_separate_by = StringInput("Family")  # "01.Family Names (Separate By Comma , - or * To Select All Matching)"; graph input
n03_specific_type_names_separate = StringInput("Type")  # "03.Specific Type Names (Separate by Comma , )"; graph input
n04_elements_in_active_view_only = BoolSelector(false)  # "04.Elements In Active View Only ?"; graph input
n07_is_type_parameter = BoolSelector(false)  # "07.Is Type Parameter ?"; graph input
n05_materials_to_randomize = StringInput("Cherry, Glass, Aluminum")  # "05.Materials to Randomize (Seperate by Symbol)"; graph input
n06_separation_symbol = StringInput(",")  # "06.Separation Symbol"; graph input
n08_name_of_material_parameters = StringInput("Material")  # "08.Name of Material Parameters to Randomize (Separate By Comma , - or * To Select All Matching)"; graph input

code_block = CodeBlock { ","; }
family_and_type_selector = Custom[Family and Type Selector](VARAllElementsofFamilyNameAlltypes=n02_all_elements_of_family_name, VARFamilyName=n01_family_names_separate_by, VARSpecificTypeNamesSeparatebySymbol=n03_specific_type_names_separate, VARSeparationSymbol=code_block, VAROnlyInActiveView=n04_elements_in_active_view_only)  # package Synthesize toolkit; Family and Type Selector
parameters_selector = Custom[Parameters Selector](VARElements=family_and_type_selector.VARElements, VARParameterNames=n08_name_of_material_parameters, VARSeparationSymbol=code_block)  # package Synthesize toolkit; Parameters Selector
randomize_material_parameters = Custom[Randomize Material Parameters](VARElementstoWorkon=family_and_type_selector.VARElements, VARIsTypeParameters=n07_is_type_parameter, VARMaterialstoRandomizeSeperatebySymbol=n05_materials_to_randomize, VARSeparationSymbol=n06_separation_symbol, VARListofParameterstoRandomize=parameters_selector)  # package Synthesize toolkit; Randomize Material Parameters

# group: Report
n01_number_of_elements = Watch(randomize_material_parameters.VARNumberofElements)  # "01.Number of Elements"; graph output
n02_elements_to_select = Watch(randomize_material_parameters.VARElementstoselect)  # "02.Elements to select"; graph output

debug_python = Custom[Debug Python]()  # package Synthesize toolkit; Debug Python
