# Dynamo graph Parameter.Randomize Material By Range with Family and Type.dyn (Dynamo 2.13.1.3887)
# author: karam@aecedx.com
# packages: Synthesize toolkit 12.5.1

# group: Input
n02_all_elements_of_family_name = BoolSelector(true)  # "02.All Elements of Family Name (All types) ?"; graph input
n01_family_names_separate_by = StringInput("Family")  # "01.Family Names (Separate By Comma , - or * To Select All Matching)"; graph input
n03_specific_type_names_separate = StringInput("Type")  # "03.Specific Type Names (Separate by Comma , )"; graph input
n04_elements_in_active_view_only = BoolSelector(false)  # "04.Elements In Active View Only ?"; graph input
n05_select_solids_of_range = DSModelElementsSelection()  # "05.Select Solids of Range"; nothing selected; graph input
n08_is_type_parameter = BoolSelector(false)  # "08.Is Type Parameter ?"; graph input
n06_materials_to_randomize = StringInput("Cherry, Glass, Aluminum")  # "06.Materials to Randomize (Seperate by Symbol)"; graph input
n07_separation_symbol = StringInput(",")  # "07.Separation Symbol"; graph input
n09_name_of_material_parameters = StringInput("Material")  # "09.Name of Material Parameters to Randomize (Separate By Comma , - or * To Select All Matching)"; graph input

code_block = CodeBlock { ","; }
family_and_type_selector = Custom[Family and Type Selector](VARAllElementsofFamilyNameAlltypes=n02_all_elements_of_family_name, VARFamilyName=n01_family_names_separate_by, VARSpecificTypeNamesSeparatebySymbol=n03_specific_type_names_separate, VARSeparationSymbol=code_block, VAROnlyInActiveView=n04_elements_in_active_view_only)  # package Synthesize toolkit; Family and Type Selector
location_of_any_element = Custom[Location Of Any Element](VARElements=family_and_type_selector.VARElements)  # package Synthesize toolkit; Location Of Any Element
geometry = Element.Geometry(element=n05_select_solids_of_range)
count = List.Count(list=geometry)
cycle = List.Cycle(list=location_of_any_element.VARElements, amount=count)
count_2 = List.Count(list=location_of_any_element.VARElements)
chop = List.Chop(list=cycle, lengths=count_2)
doesIntersect = Geometry.DoesIntersect(geometry=geometry@L1, other=location_of_any_element.VARLocations)
filterByBoolMask = List.FilterByBoolMask(list=chop, mask=doesIntersect)
code_block_2 = CodeBlock { false; }
clean = List.Clean(list=filterByBoolMask.in, preserveIndices=code_block_2)
flatten = List.Flatten(list=clean)
parameters_selector = Custom[Parameters Selector](VARElements=family_and_type_selector.VARElements, VARParameterNames=n09_name_of_material_parameters, VARSeparationSymbol=code_block, VARIsTypeParam=n08_is_type_parameter)  # package Synthesize toolkit; Parameters Selector
randomize_material_parameters = Custom[Randomize Material Parameters](VARElementstoWorkon=flatten, VARIsTypeParameters=n08_is_type_parameter, VARMaterialstoRandomizeSeperatebySymbol=n06_materials_to_randomize, VARSeparationSymbol=n07_separation_symbol, VARListofParameterstoRandomize=parameters_selector)  # package Synthesize toolkit; Randomize Material Parameters

# group: Report
n01_number_of_elements = Watch(randomize_material_parameters.VARNumberofElements)  # "01.Number of Elements"; graph output
n02_elements_to_select = Watch(randomize_material_parameters.VARElementstoselect)  # "02.Elements to select"; graph output

debug_python = Custom[Debug Python]()  # package Synthesize toolkit; Debug Python
