# Dynamo graph Parameter.Randomize Material By Selection Filter.dyn (Dynamo 2.13.1.3887)
# author: karam@aecedx.com
# packages: Synthesize toolkit 12.5.1

hot_get_all_filter = Custom[HOT.Get All Filter]()  # package Synthesize toolkit; Get all Filter
toLower = String.ToLower(string=hot_get_all_filter.VARName)
trimWhitespace = String.TrimWhitespace(string=toLower)

# group: Input
n01_selection_filter_to_read = StringInput("Fitler Name")  # "01.Selection Filter to Read"; graph input
n04_is_type_parameter = BoolSelector(false)  # "04.Is Type Parameter ?"; graph input
n02_materials_to_randomize = StringInput("Cherry, Glass, Aluminum")  # "02.Materials to Randomize (Seperate by Symbol)"; graph input
n03_separation_symbol = StringInput(",")  # "03.Separation Symbol"; graph input
n05_name_of_material_parameters = StringInput("Material")  # "05.Name of Material Parameters to Randomize (Separate By Comma , - or * To Select All Matching)"; graph input

toLower_2 = String.ToLower(string=n01_selection_filter_to_read)
trimWhitespace_2 = String.TrimWhitespace(string=toLower_2)
eq = trimWhitespace == trimWhitespace_2
filterByBoolMask = List.FilterByBoolMask(list=hot_get_all_filter.VARElement, mask=eq)
elements = Custom[CW.SelectionSet.Elements](VARselectionSet=filterByBoolMask.in)  # package Synthesize toolkit; Retrieves all elements stored in a selection set
flatten = List.Flatten(list=elements)
code_block = CodeBlock { ","; }
parameters_selector = Custom[Parameters Selector](VARElements=flatten, VARParameterNames=n05_name_of_material_parameters, VARSeparationSymbol=code_block, VARIsTypeParam=n04_is_type_parameter)  # package Synthesize toolkit; Parameters Selector
randomize_material_parameters = Custom[Randomize Material Parameters](VARElementstoWorkon=flatten, VARIsTypeParameters=n04_is_type_parameter, VARMaterialstoRandomizeSeperatebySymbol=n02_materials_to_randomize, VARSeparationSymbol=n03_separation_symbol, VARListofParameterstoRandomize=parameters_selector)  # package Synthesize toolkit; Randomize Material Parameters

# group: Report
n01_number_of_elements = Watch(randomize_material_parameters.VARNumberofElements)  # "01.Number of Elements"; graph output
n02_elements_to_select = Watch(randomize_material_parameters.VARElementstoselect)  # "02.Elements to select"; graph output

debug_python = Custom[Debug Python]()  # package Synthesize toolkit; Debug Python
