# Dynamo graph Parameter.Randomize Material By Selection.dyn (Dynamo 2.13.1.3887)
# author: karam@aecedx.com
# packages: Synthesize toolkit 12.5.1

# group: Input
n01_select_elements_to_work_on = DSModelElementsSelection()  # "01.Select Elements to Work on"; nothing selected; graph input
n04_is_type_parameter = BoolSelector(false)  # "04.Is Type Parameter ?"; graph input
n02_materials_to_randomize = StringInput("Cherry, Glass, Aluminum")  # "02.Materials to Randomize (Seperate by Symbol)"; graph input
n03_separation_symbol = StringInput(",")  # "03.Separation Symbol"; graph input
n05_name_of_material_parameters = StringInput("Material")  # "05.Name of Material Parameters to Randomize (Separate By Comma , - or * To Select All Matching)"; graph input

code_block = CodeBlock { ","; }
parameters_selector = Custom[Parameters Selector](VARElements=n01_select_elements_to_work_on, VARParameterNames=n05_name_of_material_parameters, VARSeparationSymbol=code_block, VARIsTypeParam=n04_is_type_parameter)  # package Synthesize toolkit; Parameters Selector
randomize_material_parameters = Custom[Randomize Material Parameters](VARElementstoWorkon=n01_select_elements_to_work_on, VARIsTypeParameters=n04_is_type_parameter, VARMaterialstoRandomizeSeperatebySymbol=n02_materials_to_randomize, VARSeparationSymbol=n03_separation_symbol, VARListofParameterstoRandomize=parameters_selector)  # package Synthesize toolkit; Randomize Material Parameters

# group: Report
n01_number_of_elements = Watch(randomize_material_parameters.VARNumberofElements)  # "01.Number of Elements"; graph output
n02_elements_to_select = Watch(randomize_material_parameters.VARElementstoselect)  # "02.Elements to select"; graph output

debug_python = Custom[Debug Python]()  # package Synthesize toolkit; Debug Python
