# Dynamo graph Parts.Create.dyn (Dynamo 2.13.1.3887)
# author: karam@aecedx.com
# packages: Synthesize toolkit 12.5.1

current = Document.Current()
activeView = Document.ActiveView(document=current)

# group: Input
n02_temporary_isolate_invalid = BoolSelector(false)  # "02.Temporary Isolate Invalid Elements"; graph input
n01_category_to_create_it_s_parts = Categories("OST_Walls")  # "01.Category to Create It's Parts"; graph input
n07_create_parts_for_visible = BoolSelector(false)  # "07.Create parts for Visible elements in View only ?"; graph input
n03_create_a_filter_for_new_parts = BoolSelector(true)  # "03.Create a Filter for New Parts ?"; graph input
n04_filter_name_of_new_parts = StringInput("Dynamo Walls Parts - New")  # "04.Filter name of New Parts ?"; graph input
n05_create_a_filter_for_all_parts = BoolSelector(true)  # "05.Create a Filter for All Parts ? (Including New Parts)"; graph input
n06_filter_name_of_all_parts = StringInput("Dynamo Walls Parts - All")  # "06.Filter name of All Parts"; graph input

all_elements_of_category = ElementsOfCategory(Category=n01_category_to_create_it_s_parts)
python_all_elements_in_active = Custom[Python All Elements In Active View]()  # package Synthesize toolkit; Python All Elements In Active View
code_block = CodeBlock { null; }
scopeIf = Custom[CW.ScopeIf+](VARtest=n07_create_parts_for_visible, VARtrue=python_all_elements_in_active, VARfalse=code_block)  # package Synthesize toolkit; A (hopefully) more robust implementation of ScopeIf. Tests a single boolean and returns a value accordingly.
scopeIf_2 = Custom[CW.ScopeIf+](VARtest=n07_create_parts_for_visible, VARtrue=code_block, VARfalse=all_elements_of_category)
create = List.Create(item0=scopeIf, item1=scopeIf_2)
code_block_2 = CodeBlock { false; }
clean = List.Clean(list=create, preserveIndices=code_block_2)
flatten = List.Flatten(list=clean)
python_filter_list_from_another = Custom[Python Filter List From Another List](VARItemsToFilter=all_elements_of_category, VARAllItemsToFilterFrom=flatten)  # package Synthesize toolkit; Find Intersections In Lists
slabShapeHasBeenModified = Custom[CW.Roof.SlabShapeHasBeenModified](VARroof=python_filter_list_from_another)  # package Synthesize toolkit; Checks if the shape of a roof slab has been modified with the shape editing tools
filterByBoolMask = List.FilterByBoolMask(list=python_filter_list_from_another, mask=slabShapeHasBeenModified)
code_block_3 = CodeBlock { "Angle"; }
parameterExists = Custom[CW.Element.ParameterExists](VARparam=code_block_3, VARelement=filterByBoolMask.out)  # package Synthesize toolkit; Checks if an element contains a parameter of a given name
filterByBoolMask_2 = List.FilterByBoolMask(list=filterByBoolMask.out, mask=parameterExists)
getParts = Custom[ST.Element.GetParts](VARList=filterByBoolMask_2.out)  # package Synthesize toolkit; Get parts for the elements from Input. Returns Parts and Parent elements
isEmpty = List.IsEmpty(list=getParts.VARParts@L2)
filterByBoolMask_3 = List.FilterByBoolMask(list=filterByBoolMask_2.out, mask=isEmpty)
string_from_object = FromObject(obj=filterByBoolMask_3.in)
code_block_4 = CodeBlock { "ExtrusionRoof"; }
eq = string_from_object == code_block_4
filterByBoolMask_4 = List.FilterByBoolMask(list=filterByBoolMask_3.in, mask=eq)
makeParts = Custom[ST.Element.MakeParts](VARElements=filterByBoolMask_4.out)  # package Synthesize toolkit; Create Parts from valid elements
isEmpty_2 = List.IsEmpty(list=makeParts.VARParts@L2)
filterByBoolMask_5 = List.FilterByBoolMask(list=makeParts.VARParents, mask=isEmpty_2)
code_block_5 = CodeBlock { null; }
scopeIf_3 = Custom[CW.ScopeIf+](VARtest=n02_temporary_isolate_invalid, VARtrue=filterByBoolMask_5.in, VARfalse=code_block_5)
code_block_6 = CodeBlock { false; }
clean_2 = List.Clean(list=scopeIf_3, preserveIndices=code_block_6)
flatten_2 = List.Flatten(list=clean_2)
create_2 = List.Create(item0=flatten_2)
code_block_7 = CodeBlock { null; }
create_3 = List.Create(item0=code_block_7)
replaceEmptyLists = Custom[CW.List.ReplaceEmptyLists](VARseq=create_2, VARReplacement=create_3)  # package Synthesize toolkit; Replaces all empty lists within a given list with a substitute
flatten_3 = List.Flatten(list=replaceEmptyLists)
temporarilyIsolateInView = Custom[CW.Element.TemporarilyIsolateInView](VARview=activeView, VARelement=flatten_3)  # package Synthesize toolkit; (Temporarily) isolates elements in the given view
code_block_8 = CodeBlock { null; }
scopeIf_4 = Custom[CW.ScopeIf+](VARtest=n03_create_a_filter_for_new_parts, VARtrue=n04_filter_name_of_new_parts, VARfalse=code_block_8)
scopeIf_5 = Custom[CW.ScopeIf+](VARtest=n03_create_a_filter_for_new_parts, VARtrue=makeParts.VARParts, VARfalse=code_block_8)
boolean = BoolSelector(false)
clean_3 = List.Clean(list=scopeIf_5, preserveIndices=boolean)
byElements = Custom[CW.SelectionSet.ByElements](VARName=scopeIf_4, VARelements=clean_3)  # package Synthesize toolkit; Creates a selection set of the given elements. Note that if a selection set of the given name already exists in the model, its contents will be replaced. Also, if the selection set is already applied as a view filter, the view filter will have to be manually updated in the visibility / graphic overrides. DO ***NOT*** USE IN AUTOMATIC MODE!
code_block_9 = CodeBlock { null; }
scopeIf_6 = Custom[CW.ScopeIf+](VARtest=n05_create_a_filter_for_all_parts, VARtrue=n06_filter_name_of_all_parts, VARfalse=code_block_9)
flatten_4 = List.Flatten(list=getParts.VARParts)
passthrough = Custom[CW.Passthrough](VARpassThrough=flatten_4, VARwaitFor=makeParts.VARParts)  # package Synthesize toolkit; Forces a sequential order of execution. The node wired into the output of the Passthrough node will be executed *after* the node wired into the waitFor input (e.g. important for some Revit operations). The value of the passThrough input will be passed on to the node wired into the output port of the Passthrough node.
create_4 = List.Create(item0=passthrough, item1=makeParts.VARParts)
flatten_5 = List.Flatten(list=create_4)
scopeIf_7 = Custom[CW.ScopeIf+](VARtest=n05_create_a_filter_for_all_parts, VARtrue=flatten_5, VARfalse=code_block_9)
boolean_2 = BoolSelector(false)
clean_4 = List.Clean(list=scopeIf_7, preserveIndices=boolean_2)
byElements_2 = Custom[CW.SelectionSet.ByElements](VARName=scopeIf_6, VARelements=clean_4)
debug_python = Custom[Debug Python]()  # package Synthesize toolkit; Debug Python
