# Dynamo graph Parts.Delete.dyn (Dynamo 2.13.1.3887)
# author: karam@aecedx.com
# packages: Synthesize toolkit 12.5.1

n02_delete_parts_specefied = BoolSelector(false)  # "02.Delete Parts (Specefied Category above)"; graph input
categories = Categories("OST_Parts")
all_elements_of_category = ElementsOfCategory(Category=categories)
code_block = CodeBlock { null; }
scopeIf = Custom[CW.ScopeIf+](VARtest=n02_delete_parts_specefied, VARtrue=all_elements_of_category, VARfalse=code_block)  # package Synthesize toolkit; A (hopefully) more robust implementation of ScopeIf. Tests a single boolean and returns a value accordingly.
getparents = Custom[ST.Parts.Getparents](VARParts=scopeIf)  # package Synthesize toolkit; Returns parents of selected Parts
create = List.Create(item0=getparents)
flatten = List.Flatten(list=create)
code_block_2 = CodeBlock { false; }
clean = List.Clean(list=flatten, preserveIndices=code_block_2)
getCategory = Element.GetCategory(element=clean)
string_from_object = FromObject(obj=getCategory)
n01_category_to_delete_it_s_parts = Categories("OST_Walls")  # "01.Category to Delete It's Parts"; graph input
string_from_object_2 = FromObject(obj=n01_category_to_delete_it_s_parts)
eq = string_from_object == string_from_object_2
filterByBoolMask = List.FilterByBoolMask(list=clean, mask=eq)
getParts = Custom[ST.Element.GetParts](VARList=filterByBoolMask.in)  # package Synthesize toolkit; Get parts for the elements from Input. Returns Parts and Parent elements
flatten_2 = List.Flatten(list=getParts.VARParts)
uniqueItems = List.UniqueItems(list=flatten_2)
eraser = Custom[ST.Tool.Eraser](VARList=uniqueItems)  # package Synthesize toolkit; Try to delete any element from project
n03_delete_all_parts_all = BoolSelector(false)  # "03.Delete all Parts (All Categories)"; graph input
scopeIf_2 = Custom[CW.ScopeIf+](VARtest=n03_delete_all_parts_all, VARtrue=all_elements_of_category, VARfalse=code_block)
eraser_2 = Custom[ST.Tool.Eraser](VARList=scopeIf_2)
debug_python = Custom[Debug Python]()  # package Synthesize toolkit; Debug Python
