# Dynamo graph Ramp.Auto Detail Lines By Faces Selection.dyn (Dynamo 2.13.1.3887)
# author: karam@aecedx.com
# packages: Synthesize toolkit 12.5.1

# group: Input
n02_select_ramps_start_end_edges = SelectEdges()  # "02.Select Ramps Start/End Edges"; nothing selected; graph input
n01_select_ramp_faces = SelectFaces()  # "01.Select Ramp Faces"; nothing selected; graph input
n03_distance_between_arrows = DoubleInput(2)  # "03.Distance Between Arrows"; graph input
n04_flip_direction = BoolSelector(false)  # "04.Flip Direction ?"; graph input
n07_above_cut_plane_linestyle = StringInput("<Hidden>")  # "07.Above Cut Plane Linestyle"; graph input
n06_within_cut_plane_linestyle = StringInput("Thin Lines")  # "06.Within Cut Plane Linestyle"; graph input
n05_under_cut_plane_linestyle = StringInput("<Beyond>")  # "05.Under Cut Plane Linestyle"; graph input
n11_pin_result_lines = BoolSelector(true)  # "11.Pin Result Lines ?"; graph input
n08_create_selection_filter = BoolSelector(true)  # "08.Create Selection Filter ?"; graph input
n10_filter_name = StringInput("Dynamo Ramps Auto Detail Lines")  # "10.Filter Name"; graph input
n09_overwrite_existing_filter = BoolSelector(false)  # "09.Overwrite Existing Filter ?"; graph input

flatten = List.Flatten(list=n01_select_ramp_faces)
default_linestyles_name_revit = Custom[Default Linestyles Name Revit Compatiblity](VARLinestylename=n07_above_cut_plane_linestyle)  # package Synthesize toolkit; Default Linestyles Name Revit Compatiblity
default_linestyles_name_revit_2 = Custom[Default Linestyles Name Revit Compatiblity](VARLinestylename=n06_within_cut_plane_linestyle)
default_linestyles_name_revit_3 = Custom[Default Linestyles Name Revit Compatiblity](VARLinestylename=n05_under_cut_plane_linestyle)
ramps_auto_detail_lines = Custom[Ramps Auto Detail Lines](VARRampsStartEndEdges=n02_select_ramps_start_end_edges, VARRampsFaces=flatten, VARDistanceBetweenArrows=n03_distance_between_arrows, VARFlipDirection=n04_flip_direction, VARAboveCutPlaneLinestyle=default_linestyles_name_revit, VARWithinCutPlaneLinestyle=default_linestyles_name_revit_2, VARUnderCutPlaneLinestyle=default_linestyles_name_revit_3)  # package Synthesize toolkit; Ramps Auto Detail LinesRamps Auto Detail Lines
setPinnedStatus = Custom[RH.Element.SetPinnedStatus](VARelement=ramps_auto_detail_lines, VARBool=n11_pin_result_lines)  # package Synthesize toolkit; Will set the element to either pinned or not pinned. True is pinned, false is unpinned. For multiple elements use List.Map
generate_selection_filter = Custom[Generate Selection Filter](VARCreateSelectionFilter=n08_create_selection_filter, VARFilterNametoCreate=n10_filter_name, VAROverwriteExistingFilter=n09_overwrite_existing_filter, VARElements=ramps_auto_detail_lines)  # package Synthesize toolkit; Generate Selection FIlter
debug_python = Custom[Debug Python]()  # package Synthesize toolkit; Debug Python
