# Dynamo graph Ramp.Auto Detail Lines By SAT File.dyn (Dynamo 2.13.1.3887)
# author: karam@aecedx.com
# packages: Synthesize toolkit 12.5.1

# group: Input
n02_select_ramps_start_end_edges = SelectEdges()  # "02.Select Ramps Start/End Edges"; nothing selected; graph input
n01_ramps_sat_file = Filename("No file selected.")  # "01.Ramps SAT File"; graph input
n03_exclude_ramps_with_area_less = DoubleInput(5)  # "03.Exclude Ramps With Area Less Than"; graph input
n04_distance_between_arrows = DoubleInput(2)  # "04.Distance Between Arrows"; graph input
n05_flip_direction = BoolSelector(false)  # "05.Flip Direction ?"; graph input
n08_above_cut_plane_linestyle = StringInput("<Hidden>")  # "08.Above Cut Plane Linestyle"; graph input
n07_within_cut_plane_linestyle = StringInput("Thin Lines")  # "07.Within Cut Plane Linestyle"; graph input
n06_under_cut_plane_linestyle = StringInput("<Beyond>")  # "06.Under Cut Plane Linestyle"; graph input
n12_pin_result_lines = BoolSelector(true)  # "12.Pin Result Lines ?"; graph input
n09_create_selection_filter = BoolSelector(true)  # "09.Create Selection Filter ?"; graph input
n11_filter_name = StringInput("Dynamo Ramps Auto Detail Lines")  # "11.Filter Name"; graph input
n10_overwrite_existing_filter = BoolSelector(false)  # "10.Overwrite Existing Filter ?"; graph input

ramps_faces_by_sat_file = Custom[Ramps Faces By SAT File](VARSATFile=n01_ramps_sat_file, VARFacesArea=n03_exclude_ramps_with_area_less)  # package Synthesize toolkit; Ramps Faces By SAT File
default_linestyles_name_revit = Custom[Default Linestyles Name Revit Compatiblity](VARLinestylename=n08_above_cut_plane_linestyle)  # package Synthesize toolkit; Default Linestyles Name Revit Compatiblity
default_linestyles_name_revit_2 = Custom[Default Linestyles Name Revit Compatiblity](VARLinestylename=n07_within_cut_plane_linestyle)
default_linestyles_name_revit_3 = Custom[Default Linestyles Name Revit Compatiblity](VARLinestylename=n06_under_cut_plane_linestyle)
ramps_auto_detail_lines = Custom[Ramps Auto Detail Lines](VARRampsStartEndEdges=n02_select_ramps_start_end_edges, VARRampsFaces=ramps_faces_by_sat_file, VARDistanceBetweenArrows=n04_distance_between_arrows, VARFlipDirection=n05_flip_direction, VARAboveCutPlaneLinestyle=default_linestyles_name_revit, VARWithinCutPlaneLinestyle=default_linestyles_name_revit_2, VARUnderCutPlaneLinestyle=default_linestyles_name_revit_3)  # package Synthesize toolkit; Ramps Auto Detail LinesRamps Auto Detail Lines
setPinnedStatus = Custom[RH.Element.SetPinnedStatus](VARelement=ramps_auto_detail_lines, VARBool=n12_pin_result_lines)  # package Synthesize toolkit; Will set the element to either pinned or not pinned. True is pinned, false is unpinned. For multiple elements use List.Map
generate_selection_filter = Custom[Generate Selection Filter](VARCreateSelectionFilter=n09_create_selection_filter, VARFilterNametoCreate=n11_filter_name, VAROverwriteExistingFilter=n10_overwrite_existing_filter, VARElements=ramps_auto_detail_lines)  # package Synthesize toolkit; Generate Selection FIlter
debug_python = Custom[Debug Python]()  # package Synthesize toolkit; Debug Python
