# Dynamo graph Ramp.Calculator.dyn (Dynamo 2.13.1.3887)
# author: karam@aecedx.com
# packages: Synthesize toolkit 12.5.1

# group: Input
slope = DoubleSlider(0.15, range=0..1 step 0.01)  # "03.Slope"; graph input
length = DoubleInput(0)  # "02.Length"; graph input
# note: Selection
# note: Excution
# note: Created by : Karam Baki
# Website : www.aecedx.com
# E-Mail : karam@aecedx.com
# note: Input
height = DoubleInput(0)  # "01.Height"; graph input

# group: Excution
mul = length * slope
code_block = CodeBlock { "Inactive"; 0; }
eq = mul == code_block.out1
scopeIf = Custom[CW.ScopeIf+](VARtest=eq, VARtrue=code_block.out0, VARfalse=mul)  # package Synthesize toolkit; A (hopefully) more robust implementation of ScopeIf. Tests a single boolean and returns a value accordingly.
eq_2 = height == code_block.out1
# note: Output
# note: Report
div = height / slope
scopeIf_2 = Custom[CW.ScopeIf+](VARtest=eq_2, VARtrue=code_block.out0, VARfalse=div)

# group: Report
slope_2 = Watch(slope)  # "01.Slope"; graph output
n02_result_height = Watch(scopeIf)  # "02.Result Height"; graph output
n03_result_length = Watch(scopeIf_2)  # "03.Result Length"; graph output

debug_python = Custom[Debug Python]()  # package Synthesize toolkit; Debug Python
