# Dynamo graph Reference.Ref Planes Create By Ref Planes.dyn (Dynamo 2.13.1.3887)
# author: karam@aecedx.com
# packages: Synthesize toolkit 12.5.1

# group: Input
n01_select_reference_planes = DSModelElementsSelection()  # "01.Select Reference Planes"; nothing selected; graph input
n02_delete_old_ref_planes = BoolSelector(true)  # "02.Delete Old Ref Planes ?"; graph input

code_block = CodeBlock { "ReferencePlane"; }
byClassName = Custom[SP.Filter.ByClassName](VARobject=n01_select_reference_planes, VARclassName=code_block)  # package Synthesize toolkit; Filters a list of objects by the object's class name. Note that Dynamo elements belong to different classes than their Revit counterparts. Use the Object.Class node to check an object's class.
hot_get_revit_activeview = Custom[HOT.Get Revit ActiveView]()  # package Synthesize toolkit; Active View
getCurvesInView = Custom[RH.ReferencePlane.GetCurvesInView](VARreferencePlane=byClassName.VARin, VARview=hot_get_revit_activeview)  # package Synthesize toolkit; This will obtain the geometric curves of the reference plane in a given view. Revit 2016+
code_block_2 = CodeBlock { false; }
clean = List.Clean(list=getCurvesInView, preserveIndices=code_block_2)
flatten = List.Flatten(list=clean)
hot_get_revit_activeview_2 = Custom[HOT.Get Revit ActiveView]()
getCurvesInView_2 = Custom[RH.ReferencePlane.GetCurvesInView](VARreferencePlane=byClassName.VARin, VARview=hot_get_revit_activeview_2)
startPoint = Curve.StartPoint(curve=getCurvesInView_2)
turnIntoList = Custom[CW.TurnIntoList](VARunknownItem=startPoint)  # package Synthesize toolkit; Turns an element (or a nested list) into a flat list
XYZ = Custom[LF.Point.XYZ](VARpoint=turnIntoList)  # package Synthesize toolkit; Get the X, Y, and Z components of a Point
categories = Categories("OST_Levels")
all_elements_of_category = ElementsOfCategory(Category=categories)
elevation = Level.Elevation(level=all_elements_of_category)
sortByKey = List.SortByKey(list=all_elements_of_category, keys=elevation)
firstItem = List.FirstItem(list=sortByKey.sortedKeys)
byCoordinates = Point.ByCoordinates(x=XYZ.VARX, y=XYZ.VARY, z=firstItem)
endPoint = Curve.EndPoint(curve=getCurvesInView_2)
turnIntoList_2 = Custom[CW.TurnIntoList](VARunknownItem=endPoint)
XYZ_2 = Custom[LF.Point.XYZ](VARpoint=turnIntoList_2)
lastItem = List.LastItem(list=sortByKey.sortedKeys)
byCoordinates_2 = Point.ByCoordinates(x=XYZ_2.VARX, y=XYZ_2.VARY, z=lastItem)
XYZ_3 = Custom[LF.Point.XYZ](VARpoint=turnIntoList_2)
byCoordinates_3 = Point.ByCoordinates(x=XYZ_3.VARX, y=XYZ_3.VARY, z=firstItem)
python_script = Python(IN[0]=byCoordinates, IN[1]=byCoordinates_2, IN[2]=byCoordinates_3, IN[3]=byClassName.VARin, IN[4]=n02_delete_old_ref_planes)  # IronPython2
# ---------- python_script.python (54 lines) ----------
# Enable Python support and load DesignScript library
# IMPORTANT : ALL DYNAMO DESIGN SCRIPT NODES ARE AS (dg)
import clr
clr.AddReference('ProtoGeometry')
from Autodesk.DesignScript import Geometry as dg

# EXTENSION Enable ToDSType
clr.AddReference('RevitNodes')
import Revit
clr.ImportExtensions(Revit.Elements)

# EXTENSION Enable Geometry Conversion Methods
clr.ImportExtensions(Revit.GeometryConversion)

# Enable DocumentManager and TransactionManager
clr.AddReference('RevitServices')
from RevitServices.Persistence import DocumentManager
from RevitServices.Transactions import TransactionManager


# Choose The Current Document
doc = DocumentManager.Instance.CurrentDBDocument
uidoc = DocumentManager.Instance.CurrentUIApplication.ActiveUIDocument
uiapp = DocumentManager.Instance.CurrentUIApplication
app = uiapp.Application


#unwrap all elements to use with API
xyzstart = UnwrapElement(IN[0])
xyzend = UnwrapElement(IN[1])
xyzvec = UnwrapElement(IN[2])
elems = UnwrapElement(IN[3])
delete = IN[4]

TransactionManager.Instance.EnsureInTransaction(doc)
planes = []
count = 0
for each in xyzvec:
	newplane = doc.Create.NewReferencePlane2(xyzstart[count].ToXyz(), xyzend[count].ToXyz(), each.ToXyz(), doc.ActiveView)
	subId = elems[count].LookupParameter("Subcategory").AsElementId()
	newplane.LookupParameter("Subcategory").Set(subId)
	if delete:
		name = elems[count].LookupParameter("Name").AsString()
		doc.Delete(elems[count].Id)
		newplane.LookupParameter("Name").Set(name)
	else:
		name = elems[count].LookupParameter("Name").AsString()
		newplane.LookupParameter("Name").Set(name + " " + str(newplane.Id))
	planes.append(newplane)
	count = count + 1
TransactionManager.Instance.TransactionTaskDone()

#Assign your output to the OUT variable
OUT = planes
# ----------------------------------------
count = List.Count(list=python_script)

# group: Report
n01_number_of_ref_planes_created = Watch(count)  # "01.Number of Ref Planes Created"; graph output

debug_python_no_message = Custom[Debug Python No Message]()  # package Synthesize toolkit; Debug Python
