# Dynamo graph Room.Auto Fix Heights.dyn (Dynamo 2.13.1.3887)
# author: karam@aecedx.com
# packages: Synthesize toolkit 12.5.1

# group: Input
n01_all_rooms_false_if_you_want = BoolSelector(true)  # "01.All Rooms (False If You Want to Filter By Sync Parameter)"; graph input
n02_yes_no_sync_parameter = StringInput("Sync with Dynamo")  # "02.Yes/No Sync Parameter"; graph input
n04_match_rooms_upper_limit_with = BoolSelector(true)  # "04.Match Rooms Upper Limit with Level"; graph input
n05_maximum_room_height = DoubleInput(10)  # "05.Maximum Room Height"; graph input
n06_custom_height_false_for_auto = BoolSelector(false)  # "06.Custom Height (False for Auto Calculate, Volumes must be enabled)"; graph input
n07_custom_height = DoubleInput(2)  # "07.Custom Height"; graph input
n03_justified_height_value = DoubleInput(0)  # "03.Justified Height Value"; graph input

categories = Categories("OST_Rooms")
all_elements_of_category = ElementsOfCategory(Category=categories)
state = Custom[CW.Room.State](VARroom=all_elements_of_category)  # package Synthesize toolkit; Returns the state of a room, i.e. is it placed, unplaced, redundant or not enclosed.
code_block = CodeBlock { "Placed"; }
eq = state == code_block
filterByBoolMask = List.FilterByBoolMask(list=all_elements_of_category, mask=eq)
getParameterValueByName = Element.GetParameterValueByName(element=filterByBoolMask.in, parameterName=n02_yes_no_sync_parameter)
code_block_2 = CodeBlock { 1; }
eq_2 = getParameterValueByName == code_block_2
filterByBoolMask_2 = List.FilterByBoolMask(list=filterByBoolMask.in, mask=eq_2)
scopeIf = Custom[CW.ScopeIf+](VARtest=n01_all_rooms_false_if_you_want, VARtrue=filterByBoolMask.in, VARfalse=filterByBoolMask_2.in)  # package Synthesize toolkit; A (hopefully) more robust implementation of ScopeIf. Tests a single boolean and returns a value accordingly.
flatten = List.Flatten(list=scopeIf)
count = List.Count(list=flatten)

# group: Report
n01_number_of_rooms_included = Watch(count)  # "01.Number of Rooms Included"; graph output

code_block_3 = CodeBlock { null; false; }
scopeIf_2 = Custom[CW.ScopeIf+](VARtest=n04_match_rooms_upper_limit_with, VARtrue=flatten, VARfalse=code_block_3.out0)
clean = List.Clean(list=scopeIf_2, preserveIndices=code_block_3.out1)
flatten_2 = List.Flatten(list=clean)
code_block_4 = CodeBlock { "Upper Limit"; }
code_block_5 = CodeBlock { "Limit Offset"; }
setParameterByName = Element.SetParameterByName(element=flatten, parameterName=code_block_5, value=n05_maximum_room_height)
end = Revit.Transaction.Transaction.End(input=setParameterByName)
passthrough = Custom[CW.Passthrough](VARpassThrough=flatten, VARwaitFor=end)  # package Synthesize toolkit; Forces a sequential order of execution. The node wired into the output of the Passthrough node will be executed *after* the node wired into the waitFor input (e.g. important for some Revit operations). The value of the passThrough input will be passed on to the node wired into the output port of the Passthrough node.
fix_room_heights_data = Custom[Fix Room Heights Data](VARRooms=passthrough)  # package Synthesize toolkit; Fix Room Heights Data
setParameterByName_2 = Element.SetParameterByName(element=flatten_2, parameterName=code_block_4, value=fix_room_heights_data.VARUpperLimitLevels)
code_block_6 = CodeBlock { "Limit Offset"; }
scopeIf_3 = Custom[CW.ScopeIf+](VARtest=n06_custom_height_false_for_auto, VARtrue=n07_custom_height, VARfalse=fix_room_heights_data.VARLimitOffsets)
add = scopeIf_3 + n03_justified_height_value
setParameterByName_3 = Element.SetParameterByName(element=flatten, parameterName=code_block_6, value=add)
debug_python = Custom[Debug Python]()  # package Synthesize toolkit; Debug Python
code_block_7 = CodeBlock { "Base Offset"; }
setParameterByName_4 = Element.SetParameterByName(element=flatten, parameterName=code_block_7, value=fix_room_heights_data.VARBaseOffsets)
