# Dynamo graph Room.Center Room Location and Tags.dyn (Dynamo 2.13.1.3887)
# author: karam@aecedx.com
# packages: Synthesize toolkit 12.5.1

code_block = CodeBlock { true; }
code_block_2 = CodeBlock { true; }
n01_yes_no_sync_parameter = StringInput("Sync with Dynamo")  # "01.Yes/No Sync Parameter"; graph input
centreLocation = Custom[BVN.Room.CentreLocation](VARtoggle=code_block_2, VARYesNoSyncParameter=n01_yes_no_sync_parameter)  # package Synthesize toolkit; Moves room to the centroid of the room. If the centroid is outside of the room boundary, the room will remain in its current position. Based on the custom node by Modelical.
passthrough = Custom[CW.Passthrough](VARpassThrough=code_block, VARwaitFor=centreLocation.VARroomsMoved)  # package Synthesize toolkit; Forces a sequential order of execution. The node wired into the output of the Passthrough node will be executed *after* the node wired into the waitFor input (e.g. important for some Revit operations). The value of the passThrough input will be passed on to the node wired into the output port of the Passthrough node.
moveToRoomLocation = Custom[BVN.RoomTag.MoveToRoomLocation](VARtoggle=passthrough, VARRooms=centreLocation.VARroomsMoved)  # package Synthesize toolkit; Moves room tags to the room location point. Use the Room.CentreLocation node first before using this node. Based on the script by Modelical.
debug_python = Custom[Debug Python]()  # package Synthesize toolkit; Debug Python
