# Dynamo graph Room.K-Builder (Private Locked By Karam).dyn (Dynamo 2.13.1.3887)
# packages: Synthesize toolkit 12.6.8

n01_build_rooms_of_active_view = BoolSelector(false)  # "01.Build Rooms of Active View Only ?"; graph input
n02_build_floors = BoolSelector(false)  # "02.Build Floors"; graph input
n03_floor_allow_build_parameter = StringInput("Dynamo Floor Allow Build")  # "03.Floor Allow Build Parameter (Optional)"; graph input
n04_floor_calculation_reference = StringInput("Dynamo Floor Calculation Reference")  # "04.Floor Calculation Reference (Optional)"; graph input
n05_floor_type_required = StringInput("Dynamo Floor Finish Type")  # "05.Floor Type (Required)"; graph input
n06_floor_height_offset_parameter = StringInput("Dynamo Floor Finish Height")  # "06.Floor Height Offset Parameter (Optional)"; graph input
n07_floor_boundary_offset = StringInput("Dynamo Floor Finish Boundary Offset")  # "07.Floor Boundary Offset Parameter (Optional)"; graph input
n08_build_ceilings = BoolSelector(false)  # "08.Build Ceilings"; graph input
n09_ceiling_allow_build_parameter = StringInput("Dynamo Ceiling Allow Build")  # "09.Ceiling Allow Build Parameter (Optional)"; graph input
n10_ceiling_calculation_reference = StringInput("Dynamo Ceiling Calculation Reference")  # "10.Ceiling Calculation Reference (Optional)"; graph input
n11_ceiling_type_required = StringInput("Dynamo Ceiling Finish Type")  # "11.Ceiling Type (Required)"; graph input
n12_ceiling_height_offset = StringInput("Dynamo Ceiling Finish Height")  # "12.Ceiling Height Offset Parameter (Required)"; graph input
n13_ceiling_boundary_offset = StringInput("Dynamo Ceiling Finish Boundary Offset")  # "13.Ceiling Boundary Offset Parameter (Optional)"; graph input
n14_build_walls = BoolSelector(false)  # "14.Build Walls"; graph input
n15_wall_allow_build_parameter = StringInput("Dynamo Wall Allow Build")  # "15.Wall Allow Build Parameter (Optional)"; graph input
n16_wall_calculation_reference = StringInput("Dynamo Wall Calculation Reference")  # "16.Wall Calculation Reference (Optional)"; graph input
n17_wall_finish_type_required = StringInput("Dynamo Wall Finish Type")  # "17.Wall Finish Type (Required)"; graph input
n18_wall_exclude_on_types = StringInput("Dynamo Exclude Walls On Types")  # "18.Wall Exclude On Types (Optional)"; graph input
n19_wall_include_only_on_types = StringInput("Dynamo Include Walls On Types")  # "19.Wall Include Only On Types (Optional)"; graph input
n20_wall_exclude_types_separator = StringInput(",")  # "20.Wall Exclude Types Separator (Optional)"; graph input
n21_wall_top_offset_parameter = StringInput("Dynamo Top Wall Offset")  # "21.Wall Top Offset Parameter (Optional)"; graph input
n22_wall_base_offset_parameter = StringInput("Dynamo Base Wall Offset")  # "22.Wall Base Offset Parameter (Optional)"; graph input
k_builder = Custom[K-Builder](VARBuildRoomsofActiveViewOnly=n01_build_rooms_of_active_view, VARBuildFloors=n02_build_floors, VARFloorAllowBuildParameterOptional=n03_floor_allow_build_parameter, VARFloorCalculationReferenceOptional=n04_floor_calculation_reference, VARFloorTypeRequired=n05_floor_type_required, VARFloorHeightOffsetParameterOptional=n06_floor_height_offset_parameter, VARFloorBoundaryOffsetParameterOptional=n07_floor_boundary_offset, VARBuildCeilings=n08_build_ceilings, VARCeilingAllowBuildParameterOptional=n09_ceiling_allow_build_parameter, VARCeilingCalculationReferenceOptional=n10_ceiling_calculation_reference, VARCeilingTypeRequired=n11_ceiling_type_required, VARCeilingHeightOffsetParameterRequired=n12_ceiling_height_offset, VARCeilingBoundaryOffsetParameterOptional=n13_ceiling_boundary_offset, VARBuildWalls=n14_build_walls, VARWallAllowBuildParameterOptional=n15_wall_allow_build_parameter, VARWallCalculationReferenceOptional=n16_wall_calculation_reference, VARWallFinishTypeRequired=n17_wall_finish_type_required, VARWallExcludeOnTypesOptional=n18_wall_exclude_on_types, VARWallIncludeOnlyOnTypesOptional=n19_wall_include_only_on_types, VARWallExcludeTypesSeparatorOptional=n20_wall_exclude_types_separator, VARWallTopOffsetParameterOptional=n21_wall_top_offset_parameter, VARWallBaseOffsetParameterOptional=n22_wall_base_offset_parameter)  # package Synthesize toolkit; K-Builder
report = Watch(k_builder)  # graph output
