# Dynamo graph Room.Re-Number Windows Based on Rooms Number.dyn (Dynamo 2.13.1.3887)
# author: karam@aecedx.com
# packages: Synthesize toolkit 12.5.1

code_block = CodeBlock { true; }
n01_mark_prefix = StringInput("")  # "01.Mark Prefix"; graph input
separator = StringInput("")  # "02.Separator"; graph input
n03_mark_suffix = StringInput("")  # "03.Mark Suffix"; graph input
n04_reverse_numbering = BoolSelector(false)  # "04.Reverse Numbering ?"; graph input
renumberByRoom = Custom[BVN.Window.RenumberByRoom](VARtoggle=code_block, markPrefix=n01_mark_prefix, markSeparator=separator, VARmarkSuffix=n03_mark_suffix, VARReverseNumbering=n04_reverse_numbering)  # package Synthesize toolkit; Renumbers a window's mark value based on the room it is located in. If there is no 'To' room, it will default to the 'From' room.
debug_python = Custom[Debug Python]()  # package Synthesize toolkit; Debug Python
