# Dynamo graph Room.Rooms Outlines to Family By All Rooms of Active View.dyn (Dynamo 2.13.1.3887)
# author: karam@aecedx.com
# packages: Synthesize toolkit 12.5.1

# group: Input
n02_mode_false_active_view_true = BoolSelector(false)  # "02.Mode : False = Active View | True = All Project"; graph input
n01_family_name = StringInput("Dynamo Room Family")  # "01.Family Name"; graph input

python_all_elements_in_all = Custom[Python All Elements In All Document]()  # package Synthesize toolkit; Python All Elements In All Document
python_all_elements_in_active = Custom[Python All Elements In Active View]()  # package Synthesize toolkit; Python All Elements In Active View
scopeIf = Custom[CW.ScopeIf+](VARtest=n02_mode_false_active_view_true, VARtrue=python_all_elements_in_all, VARfalse=python_all_elements_in_active)  # package Synthesize toolkit; A (hopefully) more robust implementation of ScopeIf. Tests a single boolean and returns a value accordingly.
code_block = CodeBlock { "Room"; }
byClassName = Custom[SP.Filter.ByClassName](VARobject=scopeIf, VARclassName=code_block)  # package Synthesize toolkit; Filters a list of objects by the object's class name. Note that Dynamo elements belong to different classes than their Revit counterparts. Use the Object.Class node to check an object's class.
code_block_2 = CodeBlock { true; }
python_script = Python(IN[0]=byClassName.VARin, IN[1]=code_block_2)  # IronPython2
# ---------- python_script.python (99 lines) ----------
# Enable Python support and load DesignScript library
# IMPORTANT : ALL DYNAMO DESIGN SCRIPT NODES ARE AS (dg)
import clr
clr.AddReference('ProtoGeometry')
from Autodesk.DesignScript import Geometry as dg

# EXTENSION Enable ToDSType
clr.AddReference('RevitNodes')
import Revit
clr.ImportExtensions(Revit.Elements)

# Enable Revit Elements
from Revit.Elements import *

# EXTENSION Enable Geometry Conversion Methods
clr.ImportExtensions(Revit.GeometryConversion)

# Enable Revit API
clr.AddReference('RevitAPI')
from Autodesk.Revit.DB import *

# Enable DocumentManager and TransactionManager
clr.AddReference('RevitServices')
from RevitServices.Persistence import DocumentManager
from RevitServices.Transactions import TransactionManager

# Enable ICollection List Translate
clr.AddReference("System")
import System.Collections.Generic
from System.Collections.Generic import List

dataEnteringNode = IN
# Use UnwrapElement(IN[0]) When Translating From Dynamo to Revit
masses=UnwrapElement(IN[0])
toggleonoff = IN[1]

# Choose The Current Document
doc = DocumentManager.Instance.CurrentDBDocument
uidoc = DocumentManager.Instance.CurrentUIApplication.ActiveUIDocument
uiapp = DocumentManager.Instance.CurrentUIApplication
app = uiapp.Application

class WarnSwallow(IFailuresPreprocessor):
	def PreprocessFailures(self, failuresAccessor):
		failuresAccessor.DeleteAllWarnings()
		return FailureProcessingResult.Continue

def flatten(x):
    result = []
    for el in x:
        if hasattr(el, "__iter__") and not isinstance(el, basestring):
            result.extend(flatten(el))
        else:
            result.append(el)
    return result
# Create Empty List
result = []

if toggleonoff == True:
	TransactionManager.Instance.EnsureInTransaction(doc)

	famtypeitr = []

	for each in masses:
		famtypeitr.append(each.Id)
 
	for item in famtypeitr:
		typeID = item
		srfObj = doc.GetElement(typeID)
 
    	#Get Geometry Elements
		geOptions = app.Create.NewGeometryOptions()
		geOptions.ComputeReferences = True
		geoElem = srfObj.get_Geometry(geOptions)
		tmpmeasure = []
		for es in geoElem:
			tmpmeasure.append(es)
		if len(tmpmeasure) == 1:
			tmplist = []
			for e in geoElem:
				if e.ToString() == "Autodesk.Revit.DB.GeometryInstance":
					tmplist.append(e.GetSymbolGeometry())
			if len(tmplist) == 0:
				tmplist = geoElem
			flat = flatten(tmplist)
			geoElem = flat
		#For each geometry object in geometry elements
		for geObj in geoElem:
			tmp = []
			for face in geObj.Faces:
				try:
					tmp.append(face.ToProtoType())
				except:
					pass
			if len(tmp) != 0:
				result.append(flatten(tmp))
	TransactionManager.Instance.TransactionTaskDone()

OUT = result
# ----------------------------------------
flatten = List.Flatten(list=python_script)
code_block_3 = CodeBlock { 3; }
surface_orientation_filter = Custom[Surface Orientation Filter](VARSurfaces=flatten, VAROrienataion=code_block_3)  # package Synthesize toolkit; Face Filter
flatten_2 = List.Flatten(list=surface_orientation_filter.VARSurfaces)
byGeometry = BoundingBox.ByGeometry(geom=flatten_2@L1)
minPoint = BoundingBox.MinPoint(boundingBox=byGeometry)
byOrigin = CoordinateSystem.ByOrigin(origin=minPoint)
X = Point.X(point=minPoint)
Y = Point.Y(point=minPoint)
byOrigin_2 = CoordinateSystem.ByOrigin(x=X, y=Y)
transform = Geometry.Transform(geometry=flatten_2, fromCoordinateSystem=byOrigin, contextCoordinateSystem=byOrigin_2)
code_block_4 = CodeBlock { null; }
k_family_insert = Custom[K-Family Insert](VARGeometryorSAT=transform, VARFamilyName=n01_family_name, VARMaterialName=code_block_4)  # package Synthesize toolkit; K-Family Insert
debug_python_no_message = Custom[Debug Python No Message]()  # package Synthesize toolkit; Debug Python
