# Dynamo graph Room.Spacial Diagram.dyn (Dynamo 2.13.1.3887)
# author: karam@aecedx.com
# packages: Synthesize toolkit 12.5.1

code_block = CodeBlock { true; }
lb_lunchbox_room_element = Custom[LB.LunchBox Room Element Collector](VARToggle=code_block)  # package Synthesize toolkit; Collects rooms from the Revit document

# group: Input
n01_all_rooms_false_if_you_want = BoolSelector(true)  # "01.All Rooms (False If You Want to Filter By Sync Parameter)"; graph input
n02_yes_no_sync_parameter = StringInput("Sync with Dynamo")  # "02.Yes/No Sync Parameter"; graph input
n03_category_of_the_resulted = Categories("OST_GenericModel")  # "03.Category of the Resulted Spaces"; graph input
n04_write_room_name_into = StringInput("Mark")  # "04.Write Room Name Into Parameter"; graph input
n05_write_room_area_into = StringInput("Comments")  # "05.Write Room Area Into Parameter"; graph input
n06_number_of_digits_for_areas = DoubleInput(2)  # "06.Number of Digits for Areas"; graph input
n07_create_selection_filter = BoolSelector(true)  # "07.Create Selection Filter ?"; graph input
n08_filter_name_to_create = StringInput("Dynamo Room Spacial Diagram")  # "08.Filter Name to Create"; graph input
n09_overwrite_existing_filter = BoolSelector(false)  # "09.Overwrite Existing Filter ? (False for Adding Elements)"; graph input

code_block_2 = CodeBlock { true; }
count = List.Count(list=lb_lunchbox_room_element.VARElement)
cycle = List.Cycle(list=code_block_2, amount=count)
getParameterValueByName = Element.GetParameterValueByName(element=lb_lunchbox_room_element.VARElement, parameterName=n02_yes_no_sync_parameter)
code_block_3 = CodeBlock { 1; }
eq = getParameterValueByName == code_block_3
scopeIf = Custom[CW.ScopeIf+](VARtest=n01_all_rooms_false_if_you_want, VARtrue=cycle, VARfalse=eq)  # package Synthesize toolkit; A (hopefully) more robust implementation of ScopeIf. Tests a single boolean and returns a value accordingly.
filterByBoolMask = List.FilterByBoolMask(list=lb_lunchbox_room_element.VARElement, mask=scopeIf)
flatten = List.Flatten(list=filterByBoolMask.in)
filterByBoolMask_2 = List.FilterByBoolMask(list=lb_lunchbox_room_element.VARNumber, mask=scopeIf)
flatten_2 = List.Flatten(list=filterByBoolMask_2.in)
rooms_to_directshape = Custom[Rooms To DirectShape](VARRooms=flatten, VARCategory=n03_category_of_the_resulted, VARNames=flatten_2)  # package Synthesize toolkit; Rooms To DirectShape
filterByBoolMask_3 = List.FilterByBoolMask(list=lb_lunchbox_room_element.VARName, mask=scopeIf)
flatten_3 = List.Flatten(list=filterByBoolMask_3.in)
isNull = Object.IsNull(object=rooms_to_directshape)
filterByBoolMask_4 = List.FilterByBoolMask(list=flatten_3, mask=isNull)
setParameterByName = Element.SetParameterByName(element=rooms_to_directshape, parameterName=n04_write_room_name_into, value=filterByBoolMask_4.out)
filterByBoolMask_5 = List.FilterByBoolMask(list=lb_lunchbox_room_element.VARArea, mask=scopeIf)
flatten_4 = List.Flatten(list=filterByBoolMask_5.in)
filterByBoolMask_6 = List.FilterByBoolMask(list=flatten_4, mask=isNull)
code_block_4 = CodeBlock { "0."; }
code_block_5 = CodeBlock { 1; }
withLeadingZeroes = Custom[CW.List.WithLeadingZeroes](VARnum=code_block_5, VARn=n06_number_of_digits_for_areas)  # package Synthesize toolkit; Adds leading zeros to a sequence of numbers
code_block_6 = CodeBlock(a=code_block_4, b=withLeadingZeroes) { a+b; }
toNumber = String.ToNumber(string=code_block_6)
roundToPrecision = Custom[CW.Math.RoundToPrecision](VARdbl=filterByBoolMask_6.out, VARprecision=toNumber)  # package Synthesize toolkit; Rounds a number to a specified precision
toString = Custom[SP.Number.ToString](VARnum=roundToPrecision, VARdigits=n06_number_of_digits_for_areas)  # package Synthesize toolkit; Converts the input number(s) to string. You can optionally limit the number of digits.
setParameterByName_2 = Element.SetParameterByName(element=rooms_to_directshape, parameterName=n05_write_room_area_into, value=toString)
filterByBoolMask_7 = List.FilterByBoolMask(list=flatten_2, mask=isNull)

# group: Report
n01_room_names = Watch(filterByBoolMask_4.out)  # "01.Room Names"; graph output
n02_room_numbers = Watch(filterByBoolMask_7.out)  # "02.Room Numbers"; graph output
n03_room_areas = Watch(filterByBoolMask_6.out)  # "03.Room Areas"; graph output

generate_selection_filter = Custom[Generate Selection Filter](VARCreateSelectionFilter=n07_create_selection_filter, VARFilterNametoCreate=n08_filter_name_to_create, VAROverwriteExistingFilter=n09_overwrite_existing_filter, VARElements=rooms_to_directshape)  # package Synthesize toolkit; Generate Selection FIlter
debug_python = Custom[Debug Python]()  # package Synthesize toolkit; Debug Python
