# Dynamo graph Room.Tags Delete By Selection Filter.dyn (Dynamo 2.13.1.3887)
# author: karam@aecedx.com
# packages: Synthesize toolkit 12.5.1

hot_get_all_filter = Custom[HOT.Get All Filter]()  # package Synthesize toolkit; Get all Filter
toLower = String.ToLower(string=hot_get_all_filter.VARName)
trimWhitespace = String.TrimWhitespace(string=toLower)
n01_selection_filter_to_read = StringInput("Fitler Name")  # "01.Selection Filter to Read"; graph input
toLower_2 = String.ToLower(string=n01_selection_filter_to_read)
trimWhitespace_2 = String.TrimWhitespace(string=toLower_2)
eq = trimWhitespace == trimWhitespace_2
filterByBoolMask = List.FilterByBoolMask(list=hot_get_all_filter.VARElement, mask=eq)
elements = Custom[CW.SelectionSet.Elements](VARselectionSet=filterByBoolMask.in)  # package Synthesize toolkit; Retrieves all elements stored in a selection set
flatten = List.Flatten(list=elements)
getRoomTag = Custom[CH.Room.GetRoomTag](VARroom=flatten)  # package Synthesize toolkit; Get Roomtags of input rooms
flatten_2 = List.Flatten(list=getRoomTag)
eraser = Custom[ST.Tool.Eraser](VARList=flatten_2)  # package Synthesize toolkit; Try to delete any element from project
debug_python = Custom[Debug Python]()  # package Synthesize toolkit; Debug Python
