# Dynamo graph SPG.Plan Importer.dyn (Dynamo 2.13.1.3887)
# author: karam@aecedx.com
# packages: Synthesize toolkit 12.5.1

n01_file_path_of_generated_plan = Filename("D:\Dynamo Site.sat")  # "01.File Path of Generated Plan"; graph input
importFromSAT = Geometry.ImportFromSAT(file=n01_file_path_of_generated_plan)
startPoint = Curve.StartPoint(curve=importFromSAT)
endPoint = Curve.EndPoint(curve=importFromSAT)
byStartPointEndPoint = Line.ByStartPointEndPoint(startPoint=startPoint, endPoint=endPoint)
byCurve = ModelCurve.ByCurve(curve=byStartPointEndPoint)
debug_python = Custom[Debug Python]()  # package Synthesize toolkit; Debug Python
