# Dynamo graph SPG.Site Exporter.dyn (Dynamo 2.13.1.3887)
# author: karam@aecedx.com
# packages: Synthesize toolkit 12.5.1

n01_select_site_outlines = DSModelElementsSelection()  # "01.Select Site Outlines"; nothing selected; graph input
geometry = Element.Geometry(element=n01_select_site_outlines)
flatten = List.Flatten(list=geometry)
toNurbsCurve = Curve.ToNurbsCurve(curve=flatten)
n02_exported_file_path_and_name = StringInput("D:\Dynamo Site.sat")  # "02.Exported File Path and Name ?"; graph input
exportToSAT = Geometry.ExportToSAT(geometry=toNurbsCurve, filePath=n02_exported_file_path_and_name)
debug_python = Custom[Debug Python]()  # package Synthesize toolkit; Debug Python
