# Dynamo graph Stairs.Auto Stair Path Placement of Active View.dyn (Dynamo 2.13.1.3887)
# author: karam@aecedx.com
# packages: Synthesize toolkit 12.5.1

# group: Create Stair Paths, Thanks to thurevit3
python_script = Python()  # IronPython2; unwired: IN[0]
# ---------- python_script.python (46 lines) ----------
import clr
clr.AddReference('ProtoGeometry')
from Autodesk.DesignScript.Geometry import *

#Import DocumentManager
clr.AddReference("RevitServices")
import RevitServices
from RevitServices.Persistence import DocumentManager
from RevitServices.Transactions import TransactionManager

#Import RevitAPI
clr.AddReference("RevitAPI")
import Autodesk

#Import ToDSType(bool) extension method
clr.AddReference("RevitNodes")
import Revit
from Autodesk.Revit.DB import *
from Autodesk.Revit.Creation import *
clr.ImportExtensions(Revit.Elements)
clr.ImportExtensions(Revit.GeometryConversion)


doc = DocumentManager.Instance.CurrentDBDocument
stairswithpath = list()
stairs = list()

# collect existing stairpaths in ActiveView
collpath = FilteredElementCollector(doc, doc.ActiveView.Id)
filtpath = ElementCategoryFilter(BuiltInCategory.OST_StairsPaths)
stairpaths = collpath.WherePasses(filtpath).ToElements()

# get stairs from stair path
for i in stairpaths:
	hoststair = (i.StairsId)
	stairid	= hoststair.HostElementId
	stairelem = doc.GetElement(stairid).ToDSType(True)	
	stairswithpath.append(stairelem)
	
# collect stairs in ActiveView
collstair = FilteredElementCollector(doc, doc.ActiveView.Id)
filtstair = ElementCategoryFilter(BuiltInCategory.OST_Stairs)
stairs = collstair.WherePasses(filtstair).ToElements()
	

OUT = stairs, stairswithpath
# ----------------------------------------
code_block = CodeBlock(out=python_script) { out[0]; out[1]; }
bk_remove_list_from_list_by_item = Custom[BK.Remove List from List by Item not Value](VARListOfItemsToRemove=code_block.out0, VARListToRemoveFrom=code_block.out1)  # package Synthesize toolkit; remove the items in ListA from the items in ListB and return whats left
create = List.Create(item0=bk_remove_list_from_list_by_item.VARreducedList, item1=bk_remove_list_from_list_by_item.VARunmatched)
flatten = List.Flatten(list=create)
create_paths = Python(IN[0]=flatten)  # IronPython2
# ---------- create_paths.python (58 lines) ----------
import clr
clr.AddReference('ProtoGeometry')
from Autodesk.DesignScript.Geometry import *

#Import DocumentManager
clr.AddReference("RevitServices")
import RevitServices
from RevitServices.Persistence import DocumentManager
from RevitServices.Transactions import TransactionManager

#Import RevitAPI
clr.AddReference("RevitAPI")
import Autodesk

#Import ToDSType(bool) extension method
clr.AddReference("RevitNodes")
import Revit
from Autodesk.Revit.DB import *
from Autodesk.Revit.Creation import *
clr.ImportExtensions(Revit.Elements)
clr.ImportExtensions(Revit.GeometryConversion)


doc = DocumentManager.Instance.CurrentDBDocument
uidoc = DocumentManager.Instance.CurrentUIApplication.ActiveUIDocument
stairs = UnwrapElement(IN[0])
typelist = list()
newpaths = list()
TransactionManager.Instance.EnsureInTransaction(doc)


#find stairpathtype
collpathtype = FilteredElementCollector(doc)
filtpathtype = ElementCategoryFilter(BuiltInCategory.OST_StairsPaths)
stairpathtypes = collpathtype.WherePasses(filtpathtype).ToElements()

for stairpathtype in stairpathtypes:
	istype = stairpathtype.ToString()
	if istype == "Autodesk.Revit.DB.Architecture.StairsPathType":
		typelist.append(stairpathtype)

stairpathtype = typelist[0]
pathid = stairpathtype.Id


#create stair path for stair runs
for stair in stairs:
	stairid = LinkElementId(stair.Id)
	newpath = Autodesk.Revit.DB.Architecture.StairsPath.Create(doc, stairid, pathid, doc.ActiveView.Id)
	newpaths.append(newpath)


TransactionManager.Instance.TransactionTaskDone()

doc.Regenerate()
uidoc.RefreshActiveView()

OUT = newpaths
# ----------------------------------------
code_block_2 = CodeBlock(stair_paths=create_paths) { stair_paths; }

debug_python = Custom[Debug Python]()  # package Synthesize toolkit; Debug Python
