# Dynamo graph Stairs.K-Fill Bellow Stair - Manual.dyn (Dynamo 2.13.1.3887)
# author: karam@aecedx.com
# packages: Synthesize toolkit 12.5.1

# group: Input
n01_select_stair_faces = SelectFaces()  # "01.Select Stair Faces"; nothing selected; graph input
n02_family_name = StringInput("Dynamo Stairs K-Fill")  # "02.Family Name"; graph input
category = Categories("OST_GenericModel")  # "03.Category"; graph input
n04_family_template_of_the_above = Filename("..\..\..\..\..\..\..\..\..\..\ProgramData\Autodesk\RVT 2020\Family Templates\English\Metric Generic Model.rft")  # "04.Family Template of The Above Category"; graph input

flatten = List.Flatten(list=n01_select_stair_faces)
fromDynamoSurface = Custom[CW.Element.FromDynamoSurface](VARDynamoSurface=flatten)  # package Synthesize toolkit; Returns the underlying Revit element of a given face
python_script = Python(IN[0]=fromDynamoSurface, IN[1]=flatten)  # IronPython2
# ---------- python_script.python (23 lines) ----------
import clr
clr.AddReference('RevitAPI')
from Autodesk.Revit.DB import *

elements = UnwrapElement(IN[0])
surfs = IN[1]

stairs = []
surfaces = []
count = 0
for element in elements:
	try:
		if isinstance(element,Architecture.Stairs):
			stairs.append(element)
			surfaces.append(surfs[count])
		else:
			stairs.append(element.GetStairs())
			surfaces.append(surfs[count])
	except:
		pass
	count += 1
	
OUT = stairs,surfaces
# ----------------------------------------
code_block = CodeBlock(a=python_script) { a[0]; a[1]; }
perimeterCurves = Surface.PerimeterCurves(surface=code_block.out1)
as_polycurve_bycurves = Custom[AS.[&] PolyCurve.ByCurves](VARcurves=perimeterCurves)  # package Synthesize toolkit; Create polycurves from an unordered list of curves.
ZAxis = Vector.ZAxis()
boundingBox = Element.BoundingBox(element=code_block.out0)
dimensions = Custom[ZK.BoundingBox.Dimensions](VARBoundingBox=boundingBox)  # package Synthesize toolkit; Input Bounding Box element to get its dimensions (Width, Length, Height). Setting Boolean switch to True rounds output values.
code_block_2 = CodeBlock(a=dimensions.VARHeight) { a*-2; }
extrudeAsSolid = Curve.ExtrudeAsSolid(curve=as_polycurve_bycurves.VARpolyCurve, direction=ZAxis, distance=code_block_2)
code_block_3 = CodeBlock { "Base Level"; "Base Offset"; }
getParameterValueByName = Element.GetParameterValueByName(element=code_block.out0, parameterName=code_block_3.out0)
plane = Custom[CW.Level.Plane](VARlevel=getParameterValueByName)  # package Synthesize toolkit; Retrieves the plane of a given level
ZAxis_2 = Vector.ZAxis()
getParameterValueByName_2 = Element.GetParameterValueByName(element=code_block.out0, parameterName=code_block_3.out1)
translate = Geometry.Translate(geometry=plane, direction=ZAxis_2, distance=getParameterValueByName_2)
split = Geometry.Split(geometry=extrudeAsSolid, other=translate, lacing=Longest)
count = List.Count(list=split@@L2)
code_block_4 = CodeBlock { 1; }
eq = count == code_block_4
filterByBoolMask = List.FilterByBoolMask(list=split, mask=eq)
code_block_5 = CodeBlock { false; }
clean = List.Clean(list=filterByBoolMask.out, preserveIndices=code_block_5)
boundingBox_2 = Geometry.BoundingBox(geometry=clean)
minPoint = BoundingBox.MinPoint(boundingBox=boundingBox_2)
Z = Point.Z(point=minPoint)
maximumItem = List.MaximumItem(list=Z)
eq_2 = Z == maximumItem
filterByBoolMask_2 = List.FilterByBoolMask(list=clean, mask=eq_2)
flatten_2 = List.Flatten(list=filterByBoolMask_2.in@L3)
byUnion = Custom[CW.Solid.ByUnion+](VARsolids=flatten_2@L2)  # package Synthesize toolkit; The OOTB node Solid.ByUnion occasionally fails when trying to merge solids with almost adjacent faces. This node will return the minimum amount of joined solids possible in such cases instead of returning null.
flatten_3 = List.Flatten(list=byUnion)
join_adjacent_solids = Custom[Join Adjacent Solids](VARSolids=flatten_3)  # package Synthesize toolkit; Join Adjacent Surfaces
code_block_6 = CodeBlock { false; }
getMaterials = Element.GetMaterials(element=code_block.out0)
flatten_4 = List.Flatten(list=getMaterials)
name = Material.Name(material=flatten_4)
firstItem = List.FirstItem(list=name)
count_2 = List.Count(list=join_adjacent_solids)
cycle = List.Cycle(list=firstItem, amount=count_2)
k_family_insert = Custom[K-Family Insert](VARGeometryorSAT=join_adjacent_solids@L1, VAROneFamily=code_block_6, VARFamilyName=n02_family_name, VARFamilyCategory=category, VARFamilyTemplatePath=n04_family_template_of_the_above, VARMaterialName=cycle@L1)  # package Synthesize toolkit; K-Family Insert
debug_python_no_message = Custom[Debug Python No Message]()  # package Synthesize toolkit; Debug Python
