# Dynamo graph Structural.Copping Remove By Selection.dyn (Dynamo 2.13.1.3887)
# author: karam@aecedx.com
# packages: Synthesize toolkit 12.5.1

# group: Input
n01_select_elements = DSModelElementsSelection()  # "01.Select Elements"; nothing selected; graph input

flatten = List.Flatten(list=n01_select_elements)
code_block = CodeBlock { "framing"; }
byClassName = Custom[SP.Filter.ByClassName](VARobject=flatten, VARclassName=code_block)  # package Synthesize toolkit; Filters a list of objects by the object's class name. Note that Dynamo elements belong to different classes than their Revit counterparts. Use the Object.Class node to check an object's class.
bounding_box_intersected_pairs = Custom[Bounding Box Intersected Pairs Combination](VARElements=byClassName.VARin)  # package Synthesize toolkit; Elements' Bounding Box Intersected Pairs Combination
lastItem = List.LastItem(list=bounding_box_intersected_pairs@L2)
firstItem = List.FirstItem(list=bounding_box_intersected_pairs@L2)
removeCoping = Custom[CW.FamilyInstance.RemoveCoping](VARfamilyInstance=lastItem, VARcuttingElementToBeRemoved=firstItem)  # package Synthesize toolkit; Removes a coping (cut) from a steel beam
reverse = List.Reverse(list=bounding_box_intersected_pairs@L2)
lastItem_2 = List.LastItem(list=reverse@L2)
firstItem_2 = List.FirstItem(list=reverse@L2)
removeCoping_2 = Custom[CW.FamilyInstance.RemoveCoping](VARfamilyInstance=lastItem_2, VARcuttingElementToBeRemoved=firstItem_2)
debug_python = Custom[Debug Python]()  # package Synthesize toolkit; Debug Python
