# Dynamo graph Structural.Framing Join-Disjoin By Selection.dyn (Dynamo 2.13.1.3887)
# author: karam@aecedx.com
# packages: Synthesize toolkit 12.5.1

# group: Input
n01_select_elements = DSModelElementsSelection()  # "01.Select Elements"; nothing selected; graph input
n02_disallow_join_false_allow = BoolSelector(false)  # "02.Disallow Join = False | Allow Join = True"; graph input

code_block = CodeBlock { true; false; }
scopeIf = Custom[CW.ScopeIf+](VARtest=n02_disallow_join_false_allow, VARtrue=code_block.out1, VARfalse=code_block.out0)  # package Synthesize toolkit; A (hopefully) more robust implementation of ScopeIf. Tests a single boolean and returns a value accordingly.
mod_disallowallow_join_in_str = Custom[MOD.DisallowAllow Join in STR Framing](VARstrFraming=n01_select_elements, VARTrueFalse=scopeIf)  # package Synthesize toolkit; Disallow or allow join condition at Structural Framing ends (True = Disallow | False = Allow)
debug_python = Custom[Debug Python]()  # package Synthesize toolkit; Debug Python
