# Dynamo graph Topography.Misc Subregion Thicken.dyn (Dynamo 2.13.1.3887)
# author: karam@aecedx.com
# packages: Synthesize toolkit 12.5.1

# group: Input
n01_select_subregion = DSModelElementSelection()  # "01.Select Subregion"; nothing selected; graph input
thickness = DoubleInput(0.3)  # "04.Thickness"; graph input
n02_get_solids_revit_2022_or = BoolSelector(false)  # "02.Get Solids ? (Revit 2022 or Above)"; graph input
n05_linestyle_for_border_lines = StringInput("Thin Lines")  # "05.Linestyle for Border Lines"; graph input
n08_create_selection_filter_of = BoolSelector(true)  # "08.Create Selection Filter of Lines ?"; graph input
n09_filter_name_of_lines = StringInput("Dynamo Subregion Thickened Lines")  # "09.Filter Name Of Lines"; graph input
n10_overwrite_existing_filter = BoolSelector(false)  # "10.Overwrite Existing Filter ? (False for Adding Elements)"; graph input
n06_thickened_family_name_generic = StringInput("Dynamo Subergion")  # "06.Thickened Family Name (Generic Model)"; graph input
n07_generic_model_family_template = Filename("..\..\..\..\..\..\..\..\..\..\ProgramData\Autodesk\RVT 2020\Family Templates\English\Metric Generic Model.rft")  # "07.Generic Model Family Template (.rft)"; graph input
material = StringInput("Asphalt Shingle")  # "03.Material"; graph input

polySurface = Custom[ZK.Topography.PolySurface](VARTopography=n01_select_subregion)  # package Synthesize toolkit; Convert topography element to polysurface
python_script = Python(IN[0]=polySurface.VARPolySurface, IN[1]=thickness, IN[2]=n02_get_solids_revit_2022_or)  # IronPython2
# ---------- python_script.python (159 lines) ----------
# Enable Python support and load DesignScript library
# IMPORTANT : ALL DYNAMO DESIGN SCRIPT NODES ARE AS (dg)
import clr
clr.AddReference('ProtoGeometry')
from Autodesk.DesignScript import Geometry as dg

# Enable Revit API
clr.AddReference('RevitAPI')
from Autodesk.Revit.DB import *

# Enable DocumentManager and TransactionManager
clr.AddReference('RevitServices')
from RevitServices.Persistence import DocumentManager
from RevitServices.Transactions import TransactionManager

def tolist(obj1):
	if hasattr(obj1,'__iter__'): return obj1
	return [obj1]
def flatten(x):
    result = []
    for el in x:
        if hasattr(el, "__iter__") and not isinstance(el, basestring):
            result.extend(flatten(el))
        else:
            result.append(el)
    return result

def solidmethod(polysurface,thickness):
	surfs = polysurface.Surfaces()
	result = []
	perms = []
	for s in surfs:
		try:
			perms.append(dg.PolyCurve.ByJoinedCurves(s.PerimeterCurves()))
		except:
			pass
	tranperms = []
	for p in perms:
		tranperms.append(dg.Geometry.Translate(p,0,0,thickness))
	solids = []
	count = 0
	for p in perms:
		profiles = [p,tranperms[count]]
		try:
			solids.append(dg.Solid.ByRuledLoft(profiles,True))
		except:
			pass
		count += 1
	return solids

def surfacesmethod(polysurface,thickness):
	def flatten(x):
	    result = []
	    for el in x:
	        if hasattr(el, "__iter__") and not isinstance(el, basestring):
	            result.extend(flatten(el))
	        else:
	            result.append(el)
	    return result
	
	def polysurfaceOP(surfaces,chunks):
		def smartpolysurface(surfaces,times,round=0):
			if len(surfaces) > chunks:
				if times == 0:
					return surfaces
				result = []
				chopped = [surfaces[x:x+chunks] for x in xrange(0, len(surfaces), chunks)]
				#result = chopjob(chopped)
				for chop in chopped:
					try:
						joined = dg.PolySurface.ByJoinedSurfaces(chop)
						if round != 0:
							for c in chop:
								c.Dispose()
						result.append(joined)
					except:
						for c in chop:
							result.append(c)
				times -= 1
				round += 1
				result = smartpolysurface(result,times,round)
				return result
			else:
				if isinstance(surfaces, dg.PolySurface):
					return surfaces
				else:
					return dg.PolySurface.ByJoinedSurfaces(surfaces)
		surfaces = flatten(tolist(surfaces))
		n = len(surfaces)
		times = 0
		while n > 1:
			n //= chunks
			times += 1
		times *= 1.5
		times = int(round(times))
		joined = smartpolysurface(surfaces,times)
		if isinstance(joined, list):
			joined = joined[0]
		return joined

	chunks = 12
	
	# Create Empty List
	result = []
	
	perm = polysurface.PerimeterCurves()
	tranpoly = dg.Geometry.Translate(polysurface,0,0,thickness)
	tranperm = []
	for p in perm:
		tranperm.append(dg.Geometry.Translate(p,0,0,thickness))
	
	sidesurfs = []
	count = 0
	for p in perm:
		tp = tranperm[count]
		count += 1
		p1 = p.StartPoint
		p2 = p.EndPoint
		p3 = tp.EndPoint
		p4 = tp.StartPoint
		pts = [p1,p2,p3,p4]
		try:
			surf = dg.Surface.ByPerimeterPoints(pts)
			sidesurfs.append(surf)
		except:
			pass
	sidesurf = polysurfaceOP(sidesurfs,chunks)
	allsurfs = [sidesurf,tranpoly]
	return allsurfs,flatten([perm,tranperm])
	
	
polysurface=IN[0]
thickness = IN[1]
method=IN[2]
needstran = True
if method == False:
	surfOP = surfacesmethod(polysurface,thickness)
	result = surfOP[0]
	needstran = False
else:
	if int(DocumentManager.Instance.CurrentUIApplication.Application.VersionNumber) < 2022:
		surfOP = surfacesmethod(polysurface,thickness)
		result = surfOP[0]
		needstran = False
	else:
		result = solidmethod(polysurface,thickness)

if needstran:
	perm = polysurface.PerimeterCurves()
	tranpoly = dg.Geometry.Translate(polysurface,0,0,thickness)
	tranperm = []
	for p in perm:
		tranperm.append(dg.Geometry.Translate(p,0,0,thickness))
	perm = flatten([perm,tranperm])
else:
	perm = surfOP[1]

# Assign your output to the OUT variable.
OUT = result,perm
# ----------------------------------------
code_block = CodeBlock(a=python_script) { a[0]; a[1]; }
flatten = List.Flatten(list=code_block.out1)
byCurve = ModelCurve.ByCurve(curve=flatten)
code_block_2 = CodeBlock { "Line Style"; }
element_types = ElementTypes("GraphicsStyle")
all_elements_of_type = ElementsOfType(element_type=element_types)
name = Element.Name(element=all_elements_of_type)
default_linestyles_name_revit = Custom[Default Linestyles Name Revit Compatiblity](VARLinestylename=n05_linestyle_for_border_lines)  # package Synthesize toolkit; Default Linestyles Name Revit Compatiblity
eq = name == default_linestyles_name_revit
filterByBoolMask = List.FilterByBoolMask(list=all_elements_of_type, mask=eq)
firstItem = List.FirstItem(list=filterByBoolMask.in)
setParameterByName = Element.SetParameterByName(element=byCurve, parameterName=code_block_2, value=firstItem)
code_block_3 = CodeBlock { true; }
setPinnedStatus = Custom[RH.Element.SetPinnedStatus](VARelement=setParameterByName, VARBool=code_block_3)  # package Synthesize toolkit; Will set the element to either pinned or not pinned. True is pinned, false is unpinned. For multiple elements use List.Map
generate_selection_filter = Custom[Generate Selection Filter](VARCreateSelectionFilter=n08_create_selection_filter_of, VARFilterNametoCreate=n09_filter_name_of_lines, VAROverwriteExistingFilter=n10_overwrite_existing_filter, VARElements=setParameterByName)  # package Synthesize toolkit; Generate Selection FIlter
debug_python = Custom[Debug Python]()  # package Synthesize toolkit; Debug Python
code_block_4 = CodeBlock { true; }
k_family_insert = Custom[K-Family Insert](VARGeometryorSAT=code_block.out0, VARFamilyName=n06_thickened_family_name_generic, VARFamilyTemplatePath=n07_generic_model_family_template, VARMaterialName=material, VARByPassGeometryCheck=code_block_4)  # package Synthesize toolkit; K-Family Insert
