# Dynamo graph Topography.Misc Topo By Text Notes.dyn (Dynamo 2.13.1.3887)
# author: karam@aecedx.com
# packages: Synthesize toolkit 12.5.1

python_all_elements_in_active = Custom[Python All Elements In Active View]()  # package Synthesize toolkit; Python All Elements In Active View
code_block = CodeBlock { "TextNote"; }
byClassName = Custom[SP.Filter.ByClassName](VARobject=python_all_elements_in_active, VARclassName=code_block)  # package Synthesize toolkit; Filters a list of objects by the object's class name. Note that Dynamo elements belong to different classes than their Revit counterparts. Use the Object.Class node to check an object's class.
code_block_2 = CodeBlock { "[0-9]+"; }
text = TextNote.Text(textNote=byClassName.VARin)
trimWhitespace = String.TrimWhitespace(string=text)
findRegularExpression = Custom[CW.String.FindRegularExpression](VARRegEx=code_block_2, VARstr=trimWhitespace)  # package Synthesize toolkit; Returns all occurences of a regular expression within a string (or list of strings). The syntax for regular expressions is explained at http://ironpython-test.readthedocs.org/en/latest/howto/regex.html
python_null_2_empty = Custom[Python Null 2 Empty](VARIN=findRegularExpression)  # package Synthesize toolkit; Python Null 2 Empty
isEmpty = List.IsEmpty(list=python_null_2_empty, lacing=Longest)
filterByBoolMask = List.FilterByBoolMask(list=byClassName.VARin, mask=isEmpty)
location_of_any_element = Custom[Location Of Any Element](VARElements=filterByBoolMask.out)  # package Synthesize toolkit; Location Of Any Element
XYZ = Custom[LF.Point.XYZ](VARpoint=location_of_any_element.VARLocations)  # package Synthesize toolkit; Get the X, Y, and Z components of a Point
byCoordinates = Point.ByCoordinates(x=XYZ.VARX, y=XYZ.VARY, z=XYZ.VARZ)
byPoints = Topography.ByPoints(points=byCoordinates)
note = StringInput("Please Temporary Isolate Text Notes Before Running This Script.")  # "01.Note"; graph input
debug_python = Custom[Debug Python]()  # package Synthesize toolkit; Debug Python
