# Dynamo graph Topography.Misc Water By All Topography.dyn (Dynamo 2.13.1.3887)
# author: karam@aecedx.com
# packages: Synthesize toolkit 12.5.1

debug_python = Custom[Debug Python]()  # package Synthesize toolkit; Debug Python

# group: Input
n01_select_topography = DSModelElementSelection()  # "01.Select Topography"; nothing selected; graph input
n07_water_level = Levels("Level 1")  # "07.Water Level"; graph input
n09_water_offset_from_topogarphy = DoubleInput(1)  # "09.Water Offset From Topogarphy Sides"; graph input
n08_water_depth = DoubleInput(30)  # "08.Water Depth"; graph input
n02_build_subregion_bellow_water = BoolSelector(true)  # "02.Build Subregion Bellow Water"; graph input
n03_family_name = StringInput("Dynamo Water Family")  # "03.Family Name"; graph input
n05_family_category = Categories("OST_GenericModel")  # "05.Family Category"; graph input
n06_family_template = Filename("..\..\..\..\..\..\..\..\..\..\ProgramData\Autodesk\RVT 2020\Family Templates\English\Metric Generic Model.rft")  # "06.Family Template"; graph input
n04_water_material = StringInput("Water")  # "04.Water Material"; graph input

code_block = CodeBlock { true; }
polySurface = Custom[ZK.Topography.PolySurface](VARTopography=n01_select_topography, VARFullTopo=code_block)  # package Synthesize toolkit; Convert topography element to polysurface
perimeterCurves = Surface.PerimeterCurves(surface=polySurface.VARPolySurface)
plane = Custom[CW.Level.Plane](VARlevel=n07_water_level)  # package Synthesize toolkit; Retrieves the plane of a given level
pullOntoPlane = Curve.PullOntoPlane(curve=perimeterCurves, plane=plane, lacing=Longest)
as_polycurve_bycurves = Custom[AS.[&] PolyCurve.ByCurves](VARcurves=pullOntoPlane)  # package Synthesize toolkit; Create polycurves from an unordered list of curves.
closeWithLine = PolyCurve.CloseWithLine(polyCurve=as_polycurve_bycurves.VARpolyCurve)
code_block_2 = CodeBlock { -1; }
mul = n09_water_offset_from_topogarphy * code_block_2
code_block_3 = CodeBlock { false; }
offset = PolyCurve.Offset(polyCurve=closeWithLine, signedDistance=mul, extendCircular=code_block_3)
as_polycurve_bycurves_2 = Custom[AS.[&] PolyCurve.ByCurves](VARcurves=offset)
curves = PolyCurve.Curves(polyCurve=as_polycurve_bycurves_2.VARpolyCurve)
simplify = Custom[SP.CurveLoop.Simplify](VARcurveLoop=curves)  # package Synthesize toolkit; Attempts to simplify an open or a closed curve loop by connecting straight separate line segments into a single line.
as_polycurve_bycurves_3 = Custom[AS.[&] PolyCurve.ByCurves](VARcurves=simplify@L2)
code_block_4 = CodeBlock { 20; }
code_block_5 = CodeBlock { false; }
code_block_6 = CodeBlock { 50; }
code_block_7 = CodeBlock { 0.5; }
join_or_extract_by_angle_range = Custom[Join or Extract By Angle Range](VARCurves=as_polycurve_bycurves_3.VARpolyCurve@L1, VARMaximumAngleDetectionRange=code_block_4, VARFlattentoNearestLevel=code_block_5, VARNumberofControlPointsDesired=code_block_6, VARExactSameLineIgnoresNumberofControlPointsDesiredUsefulforConvertingIntoSmartLines=code_block_5, VARSplitNormalizeFactorExactSameLineMustbeFasleWorksforClosedLoopsOnly=code_block_7)  # package Synthesize toolkit; Join or Extract By Angle Range
flatten = List.Flatten(list=join_or_extract_by_angle_range)
as_polycurve_bycurves_4 = Custom[AS.[&] PolyCurve.ByCurves](VARcurves=flatten)
topography_water = Custom[Topography Water](VARWaterBoundary=as_polycurve_bycurves_4.VARpolyCurve, VARWaterDepth=n08_water_depth, VARWaterLevel=n07_water_level, VARTopographyPolysurface=polySurface.VARPolySurface, VARTopography=n01_select_topography, VARBuildSubregionBellowWateer=n02_build_subregion_bellow_water)  # package Synthesize toolkit; Topography Water
k_family_insert = Custom[K-Family Insert](VARGeometryorSAT=topography_water, VARFamilyName=n03_family_name, VARFamilyCategory=n05_family_category, VARFamilyTemplatePath=n06_family_template, VARMaterialName=n04_water_material)  # package Synthesize toolkit; K-Family Insert
