# Dynamo graph Topography.Site Designer Sidewalks Create.dyn (Dynamo 2.13.1.3887)
# author: karam@aecedx.com
# packages: Synthesize toolkit 12.5.1

# group: Input
n03_adaptive_family_load_any = FamilyTypes()  # "03.Adaptive Family (Load Any Sample Sidewalk Family From Extra Folder)"; nothing selected; graph input
n01_select_streets_curbs = DSModelElementsSelection()  # "01.Select Streets & Curbs"; nothing selected; graph input
n02_sidewalks_offset = DoubleInput(-0.102)  # "02.Sidewalks Offset"; graph input
n04_adaptive_placement_spacing = DoubleInput(1)  # "04.Adaptive Placement Spacing"; graph input
n08_create_selection_filter = BoolSelector(true)  # "08.Create Selection Filter ?"; graph input
n09_selection_filter_name = StringInput("Dynamo Sidewalks & Curbs")  # "09.Selection Filter Name"; graph input
n06_family_template_of_the_above = Filename("..\..\..\..\..\..\..\..\..\..\ProgramData\Autodesk\RVT 2020\Family Templates\English\Metric Generic Model.rft")  # "06.Family Template of The Above Category"; graph input
category = Categories("OST_GenericModel")  # "05.Category"; graph input
n07_material_name = StringInput("Dynamo Sidewalk Material")  # "07.Material Name"; graph input

code_block = CodeBlock { 0; false; true; 3; }
name = Family.Name(family=n01_select_streets_curbs)
code_block_2 = CodeBlock { "Curb"; }
contains = String.Contains(string=name, searchFor=code_block_2)
filterByBoolMask = List.FilterByBoolMask(list=n01_select_streets_curbs, mask=contains)
turnIntoList = Custom[CW.TurnIntoList](VARunknownItem=filterByBoolMask.in)  # package Synthesize toolkit; Turns an element (or a nested list) into a flat list
element_geometry_fast = Custom[Element.Geometry Fast](VARElements=turnIntoList)  # package Synthesize toolkit; Element.Geometry Fast
flatten = List.Flatten(list=element_geometry_fast)
explode = Geometry.Explode(geometry=flatten)
filterByOrientation = Custom[CW.Surface.FilterByOrientation](VARsurfaces=explode)  # package Synthesize toolkit; Sorts surfaces in three lists based on their orientation (vertical, horizontal up & horizontal down) and also returns three corresponding lists of booleans.
area = Surface.Area(surface=filterByOrientation.VARvertical)
code_block_3 = CodeBlock { 3; }
round = Math.Round(number=area, digits=code_block_3)
maximumItem = List.MaximumItem(list=area)
round_2 = Math.Round(number=maximumItem, digits=code_block_3)
eq = round == round_2
filterByBoolMask_2 = List.FilterByBoolMask(list=filterByOrientation.VARvertical, mask=eq)
flatten_2 = List.Flatten(list=filterByBoolMask_2.in)
python_script = Python(IN[0]=flatten_2, IN[1]=n02_sidewalks_offset)  # IronPython2
# ---------- python_script.python (55 lines) ----------
# Enable Python support and load DesignScript library
# IMPORTANT : ALL DYNAMO DESIGN SCRIPT NODES ARE AS (dg)
import clr
clr.AddReference('ProtoGeometry')
from Autodesk.DesignScript import Geometry as dg

# EXTENSION Enable ToDSType
clr.AddReference('RevitNodes')
import Revit
clr.ImportExtensions(Revit.Elements)

# Enable Revit Elements
from Revit.Elements import *

# EXTENSION Enable Geometry Conversion Methods
clr.ImportExtensions(Revit.GeometryConversion)

# Enable Revit API
clr.AddReference('RevitAPI')
from Autodesk.Revit.DB import *

# Enable DocumentManager and TransactionManager
clr.AddReference('RevitServices')
from RevitServices.Persistence import DocumentManager
from RevitServices.Transactions import TransactionManager

# Enable ICollection List Translate
clr.AddReference("System")
import System.Collections.Generic
from System.Collections.Generic import List

dataEnteringNode = IN
# Use UnwrapElement(IN[0]) When Translating From Dynamo to Revit
surfs=UnwrapElement(IN[0])
thick=UnwrapElement(IN[1])

# Choose The Current Document
doc = DocumentManager.Instance.CurrentDBDocument
uidoc = DocumentManager.Instance.CurrentUIApplication.ActiveUIDocument
uiapp = DocumentManager.Instance.CurrentUIApplication
app = uiapp.Application

# Create Empty List
result = []

for e in surfs:
	if thick != 0:
		solid = dg.Surface.Thicken(e, thick, False)
		explode = dg.Geometry.Explode(solid)
		result.append(explode[1])
	else:
		result.append(e)

# Assign your output to the OUT variable.
OUT = result
# ----------------------------------------
perimeterCurves = Surface.PerimeterCurves(surface=python_script)
length = Curve.Length(curve=perimeterCurves)
maximumItem_2 = List.MaximumItem(list=length)
eq_2 = length == maximumItem_2
filterByBoolMask_3 = List.FilterByBoolMask(list=perimeterCurves, mask=eq_2)
code_block_4 = CodeBlock { 0.5; }
pointAtParameter = Curve.PointAtParameter(curve=filterByBoolMask_3.in, param=code_block_4)
Z = Point.Z(point=pointAtParameter)
maximumItem_3 = List.MaximumItem(list=Z)
eq_3 = Z == maximumItem_3
filterByBoolMask_4 = List.FilterByBoolMask(list=filterByBoolMask_3.in, mask=eq_3)
flatten_3 = List.Flatten(list=filterByBoolMask_4.in)
coordinate_system_adaptive = Custom[Coordinate System Adaptive Curves Prepare](VARCurves=flatten_3, VARSpacing=n04_adaptive_placement_spacing, VARRotationDegree=code_block.out0, VARMinimumNumber=code_block.out3)  # package Synthesize toolkit; Coordinate System Adaptive Curves Prepare
k_super_adaptive_paneling = Custom[K-Super Adaptive Paneling](VARFamilyType=n03_adaptive_family_load_any, VARFlip=code_block.out1, VARReversePlacementDirection=code_block.out1, VARZAlwaysUp=code_block.out2, VARCoordinateSystem=coordinate_system_adaptive, VARDegreesZAxis=code_block.out0)  # package Synthesize toolkit; K-Super Adaptive Paneling
element_geometry_fixer_legacy = Custom[Element.Geometry Fixer Legacy](VARElements=k_super_adaptive_paneling)  # package Synthesize toolkit; Element.Geometry Fixer Legacy
passthrough = Custom[CW.Passthrough](VARpassThrough=k_super_adaptive_paneling, VARwaitFor=element_geometry_fixer_legacy)  # package Synthesize toolkit; Forces a sequential order of execution. The node wired into the output of the Passthrough node will be executed *after* the node wired into the waitFor input (e.g. important for some Revit operations). The value of the passThrough input will be passed on to the node wired into the output port of the Passthrough node.
flatten_4 = List.Flatten(list=passthrough)
eraser = Custom[ST.Tool.Eraser](VARList=flatten_4)  # package Synthesize toolkit; Try to delete any element from project
code_block_5 = CodeBlock { false; }
code_block_6 = CodeBlock { "Surface"; }
byClassName = Custom[SP.Filter.ByClassName](VARobject=element_geometry_fixer_legacy, VARclassName=code_block_6)  # package Synthesize toolkit; Filters a list of objects by the object's class name. Note that Dynamo elements belong to different classes than their Revit counterparts. Use the Object.Class node to check an object's class.
perimeterCurves_2 = Surface.PerimeterCurves(surface=byClassName.VARin)
byJoinedCurves = PolyCurve.ByJoinedCurves(curves=perimeterCurves_2)
transpose = List.Transpose(lists=byJoinedCurves@L3)
byLoft = Solid.ByLoft(crossSections=transpose, guideCurves=flatten_3)
transpose_2 = List.Transpose(lists=byLoft)
smart_rft_path = Custom[Smart RFT Path](VARRFTFile=n06_family_template_of_the_above, VARCategory=category)  # package Synthesize toolkit; Smart RFT Path
code_block_7 = CodeBlock { "Dynamo Sidewalk"; }
code_block_8 = CodeBlock { " "; }
code_block_9 = CodeBlock { "[0-9]+"; }
familyInstances = Custom[SP.Collector.FamilyInstances](VARinstnaceName=code_block_7)  # package Synthesize toolkit; Collects placed family instance elements from the document that match the name. Partially mathing elements are collected as well. If no matches are found, a list of all isntance names will be output.
python_script_2 = Python(IN[0]=familyInstances.VARpartialmatch)  # IronPython2
# ---------- python_script_2.python (54 lines) ----------
# Enable Python support and load DesignScript library
# IMPORTANT : ALL DYNAMO DESIGN SCRIPT NODES ARE AS (dg)
import clr
clr.AddReference('ProtoGeometry')
from Autodesk.DesignScript import Geometry as dg

# EXTENSION Enable ToDSType
clr.AddReference('RevitNodes')
import Revit
clr.ImportExtensions(Revit.Elements)

# Enable Revit Elements
from Revit.Elements import *

# EXTENSION Enable Geometry Conversion Methods
clr.ImportExtensions(Revit.GeometryConversion)

# Enable Revit API
clr.AddReference('RevitAPI')
from Autodesk.Revit.DB import *

# Enable DocumentManager and TransactionManager
clr.AddReference('RevitServices')
from RevitServices.Persistence import DocumentManager
from RevitServices.Transactions import TransactionManager

# Enable ICollection List Translate
clr.AddReference("System")
import System.Collections.Generic
from System.Collections.Generic import List

dataEnteringNode = IN
# Use UnwrapElement(IN[0]) When Translating From Dynamo to Revit
elems=UnwrapElement(IN[0])

# Choose The Current Document
doc = DocumentManager.Instance.CurrentDBDocument
uidoc = DocumentManager.Instance.CurrentUIApplication.ActiveUIDocument
uiapp = DocumentManager.Instance.CurrentUIApplication
app = uiapp.Application

# Create Empty List
result = []
for each in elems:
	try:
		result.append(each.Name)
	except:
		pass

if len(result) == 0:
	result = None
	
# Assign your output to the OUT variable.
OUT = result
# ----------------------------------------
findRegularExpression = Custom[CW.String.FindRegularExpression](VARRegEx=code_block_9, VARstr=python_script_2)  # package Synthesize toolkit; Returns all occurences of a regular expression within a string (or list of strings). The syntax for regular expressions is explained at http://ironpython-test.readthedocs.org/en/latest/howto/regex.html
python_script_3 = Python(IN[0]=findRegularExpression)  # IronPython2
# ---------- python_script_3.python (66 lines) ----------
# Enable Python support and load DesignScript library
# IMPORTANT : ALL DYNAMO DESIGN SCRIPT NODES ARE AS (dg)
import clr
clr.AddReference('ProtoGeometry')
from Autodesk.DesignScript import Geometry as dg

# EXTENSION Enable ToDSType
clr.AddReference('RevitNodes')
import Revit
clr.ImportExtensions(Revit.Elements)

# Enable Revit Elements
from Revit.Elements import *

# EXTENSION Enable Geometry Conversion Methods
clr.ImportExtensions(Revit.GeometryConversion)

# Enable Revit API
clr.AddReference('RevitAPI')
from Autodesk.Revit.DB import *

# Enable DocumentManager and TransactionManager
clr.AddReference('RevitServices')
from RevitServices.Persistence import DocumentManager
from RevitServices.Transactions import TransactionManager

# Enable ICollection List Translate
clr.AddReference("System")
import System.Collections.Generic
from System.Collections.Generic import List

dataEnteringNode = IN
# Use UnwrapElement(IN[0]) When Translating From Dynamo to Revit
inside=UnwrapElement(IN[0])

# Choose The Current Document
doc = DocumentManager.Instance.CurrentDBDocument
uidoc = DocumentManager.Instance.CurrentUIApplication.ActiveUIDocument
uiapp = DocumentManager.Instance.CurrentUIApplication
app = uiapp.Application

def flatten(x):
    result = []
    for el in x:
        if hasattr(el, "__iter__") and not isinstance(el, basestring):
            result.extend(flatten(el))
        else:
            result.append(el)
    return result

# Create Empty List

try:
	result = flatten(inside)
	flresult = []
	for e in result:
		try:
			flresult.append(float(e))
		except: pass
	finalresult = sorted(flresult)
except:
	finalresult = []
	

# Assign your output to the OUT variable.
OUT = finalresult
# ----------------------------------------
list_lastitem_fixer = Custom[List.LastItem Fixer](VARlist=python_script_3)  # package Synthesize toolkit; List.LastItem Fixer
code_block_10 = CodeBlock(a=list_lastitem_fixer) { a+1; }
isNull = Object.IsNull(object=code_block_10)
code_block_11 = CodeBlock { 1; }
scopeIf = Custom[CW.ScopeIf+](VARtest=isNull, VARtrue=code_block_11, VARfalse=code_block_10)  # package Synthesize toolkit; A (hopefully) more robust implementation of ScopeIf. Tests a single boolean and returns a value accordingly.
count = List.Count(list=transpose_2)
sequence = Sequence(start=scopeIf, amount=count, lacing=Longest)
string_from_object = FromObject(obj=sequence)
code_block_12 = CodeBlock { "."; }
split = String.Split(string=string_from_object, separator0=code_block_12)
firstItem = List.FirstItem(list=split@L2)
code_block_13 = CodeBlock(a=code_block_7, b=code_block_8, c=firstItem) { a+b+c; }
code_block_14 = CodeBlock { 1; }
chop = List.Chop(list=code_block_13, lengths=code_block_14)
code_block_15 = CodeBlock { " "; }
code_block_16 = CodeBlock { 1; }
count_2 = List.Count(list=transpose_2)
sequence_2 = Sequence(start=code_block_16, amount=count_2, lacing=Longest)
string_from_object_2 = FromObject(obj=sequence_2)
code_block_17 = CodeBlock { "."; }
split_2 = String.Split(string=string_from_object_2, separator0=code_block_17)
firstItem_2 = List.FirstItem(list=split_2@L2)
code_block_18 = CodeBlock(a=n07_material_name, b=code_block_15, c=firstItem_2) { a+b+c; }
chop_2 = List.Chop(list=code_block_18, lengths=code_block_14)
byGeometry = Custom[SP.FamilyInstance.ByGeometry](VARgeometry=transpose_2, VARfamilyTemplatePath=smart_rft_path, VARfamilyName=chop, VARcategory=category, VARmaterialName=chop_2)  # package Synthesize toolkit; You must provide a valid family template path that will be used for all input geometry objects. The project units(and not the templates) will be used to determine the size of the output geometry. The provided category will be used only if the family template supports it. If not, the default template category will be used instead. Likewise, the family material(provided as a string) will be set only if a material with that name exists in the template. If not, the default material will be used instead ("By Category"). For void cuts, the material settings will be ignored. The Subcategory name is an optional input. If you'd like to skip assigning a Subcategory to any new instance, simply use null. The node expects a unique family name for each geometry object. The rest of the input lists will be processed as if the node lacing is set to longest.
code_block_19 = CodeBlock { false; }
clean = List.Clean(list=byGeometry.VARinstance, preserveIndices=code_block_19)
flatten_5 = List.Flatten(list=clean)
generate_selection_filter = Custom[Generate Selection Filter](VARCreateSelectionFilter=n08_create_selection_filter, VARFilterNametoCreate=n09_selection_filter_name, VAROverwriteExistingFilter=code_block_5, VARElements=flatten_5)  # package Synthesize toolkit; Generate Selection FIlter
flatten_6 = List.Flatten(list=byGeometry.VARinstance)
code_block_20 = CodeBlock { "Comments"; }
code_block_21 = CodeBlock { "-"; }
explode_2 = Geometry.Explode(geometry=transpose_2)
area_2 = Surface.Area(surface=explode_2)
code_block_22 = CodeBlock { 3; }
round_3 = Math.Round(number=area_2, digits=code_block_22)
maximumItem_4 = List.MaximumItem(list=area_2)
round_4 = Math.Round(number=maximumItem_4, digits=code_block_22)
eq_4 = round_4 == round_3
filterByBoolMask_5 = List.FilterByBoolMask(list=round_3, mask=eq_4)
flatten_7 = List.Flatten(list=filterByBoolMask_5.in@L3)
string_from_object_3 = FromObject(obj=flatten_7)
join = String.Join(separator=code_block_21, string0=string_from_object_3)
flatten_8 = List.Flatten(list=join)
setParameterByName = Element.SetParameterByName(element=flatten_6, parameterName=code_block_20, value=flatten_8)
debug_python = Custom[Debug Python]()  # package Synthesize toolkit; Debug Python
