# Dynamo graph Views.Analyse View Range By Excel Data.dyn (Dynamo 2.13.1.3887)
# author: karam@aecedx.com
# packages: Synthesize toolkit 12.5.1

# group: Credits
# note: Copyright (c) 2016, AECOM
# Written by: Matthew Anderle & Chris Williams
# Enhanced by : Karam Baki

# group: Input
n02_excel_file_path_to_save_to = StringInput("D:\View Range Report.csv")  # "02.Excel File Path to Save to :"; graph input
n04_filter_by_name_containment = BoolSelector(true)  # "04.Filter by Name Containment ? (False For All Views)"; graph input
n03_false_floor_plans_true = BoolSelector(false)  # "03.False = Floor Plans | True = Ceiling Plans"; graph input
name = StringInput("Level")  # "05.Name"; graph input

worksheet_name = StringInput("Views Ranges")
code_block = CodeBlock { null; false; }
mod_get_views_by_type = Custom[MOD.Get Views By Type]()  # package Synthesize toolkit; Get all views in the project classified by type
scopeIf = Custom[CW.ScopeIf+](VARtest=n03_false_floor_plans_true, VARtrue=mod_get_views_by_type.VARceilingPlans, VARfalse=mod_get_views_by_type.VARfloorPlans)  # package Synthesize toolkit; A (hopefully) more robust implementation of ScopeIf. Tests a single boolean and returns a value accordingly.

# group: Get All Views of Types ViewPlan
watch = 03.Watch(scopeIf)  # graph output

code_block_2 = CodeBlock { "View Name"; }
getParameterValueByName = Element.GetParameterValueByName(element=scopeIf, parameterName=code_block_2)
as_list_sortbykey = Custom[AS.[&] List.SortByKey](VARlist=watch, VARkeys=getParameterValueByName)  # package Synthesize toolkit; Sort a list (or lists) according to the order specified by the key list.
scopeIf_2 = Custom[CW.ScopeIf+](VARtest=n04_filter_by_name_containment, VARtrue=code_block.out0, VARfalse=as_list_sortbykey.VARsortedlist)

# group: Capture View Names
name_2 = Element.Name(element=as_list_sortbykey.VARsortedlist)
watch_2 = 01.Watch(name_2)  # graph output

boolean = BoolSelector(true)

# group: Connect Node to Filter by String.Contains Logic
contains = String.Contains(string=watch_2, searchFor=name, ignoreCase=boolean)
watch_3 = 02.Watch(contains)  # graph output

# group: Filter View List by Search String
filterByBoolMask = List.FilterByBoolMask(list=as_list_sortbykey.VARsortedlist, mask=watch_3)

# group: Suspend Creating View List in Excel with Freeze
watch_4 = 04.Watch(filterByBoolMask.in)  # graph output

scopeIf_3 = Custom[CW.ScopeIf+](VARtest=n04_filter_by_name_containment, VARtrue=watch_4, VARfalse=code_block.out0)
create = List.Create(item0=scopeIf_2, item1=scopeIf_3)
clean = List.Clean(list=create, preserveIndices=code_block.out1)
flatten = List.Flatten(list=clean)

# group: Extract Element IDs
id = Element.Id(element=flatten)

# group: Capture View Range Settings by View
python_get_view_range_settings = Python(IN[0]=flatten)  # IronPython2
# ---------- python_get_view_range_settings.python (44 lines) ----------
import clr
clr.AddReference('RevitAPI')
from Autodesk.Revit.DB import *

clr.AddReference("RevitNodes")
import Revit
clr.ImportExtensions(Revit.Elements)

clr.AddReference("RevitServices")
import RevitServices
from RevitServices.Persistence import DocumentManager
from RevitServices.Transactions import TransactionManager

doc = DocumentManager.Instance.CurrentDBDocument
viewList = UnwrapElement(IN[0])

topC_lvl=[]
topC_Off=[]
cutP_lvl=[]
cutP_Off=[]
botP_lvl=[]
botP_Off=[]
dpthP_lvl=[]
dpthP_Off=[]
undrP_lvl=[]
undrP_Off=[]

for v in viewList:
	topC_lvl.append(doc.GetElement(v.GetViewRange().GetLevelId(PlanViewPlane.TopClipPlane)))
	topC_Off.append(v.GetViewRange().GetOffset(PlanViewPlane.TopClipPlane))
	cutP_lvl.append(doc.GetElement(v.GetViewRange().GetLevelId(PlanViewPlane.CutPlane)))
	cutP_Off.append(v.GetViewRange().GetOffset(PlanViewPlane.CutPlane))
	botP_lvl.append(doc.GetElement(v.GetViewRange().GetLevelId(PlanViewPlane.BottomClipPlane)))
	botP_Off.append(v.GetViewRange().GetOffset(PlanViewPlane.BottomClipPlane))
	dpthP_lvl.append(doc.GetElement(v.GetViewRange().GetLevelId(PlanViewPlane.ViewDepthPlane)))
	dpthP_Off.append(v.GetViewRange().GetOffset(PlanViewPlane.ViewDepthPlane))

TransactionManager.Instance.EnsureInTransaction(doc)


	
TransactionManager.Instance.TransactionTaskDone()

OUT = [topC_lvl, topC_Off, cutP_lvl, cutP_Off, botP_lvl, botP_Off, dpthP_lvl, dpthP_Off]
# ----------------------------------------

watch_5 = 06.Watch(python_get_view_range_settings)  # graph output
code_block_3 = CodeBlock { 1; 3; 5; 7; }
getItemAtIndex = List.GetItemAtIndex(list=watch_5, index=code_block_3.out0)
n01_unit_types = UnitTypes("Length")  # "01.Unit Types"; graph input
displayUnitType = Custom[CW.UnitType.DisplayUnitType](VARunitType=n01_unit_types)  # package Synthesize toolkit; Retrieves the display unit type for a given unit type.
toDisplayUnit = Custom[CW.InternalUnit.ToDisplayUnit](VARval=getItemAtIndex, VARdisplayUnitType=displayUnitType.VARdisplayUnitType)  # package Synthesize toolkit; Converts a value from Revit's internal unit to a given display unit
replaceItemAtIndex = List.ReplaceItemAtIndex(list=watch_5, index=code_block_3.out0, item=toDisplayUnit)
getItemAtIndex_2 = List.GetItemAtIndex(list=watch_5, index=code_block_3.out1)
toDisplayUnit_2 = Custom[CW.InternalUnit.ToDisplayUnit](VARval=getItemAtIndex_2, VARdisplayUnitType=displayUnitType.VARdisplayUnitType)
replaceItemAtIndex_2 = List.ReplaceItemAtIndex(list=replaceItemAtIndex, index=code_block_3.out1, item=toDisplayUnit_2)
getItemAtIndex_3 = List.GetItemAtIndex(list=watch_5, index=code_block_3.out2)
toDisplayUnit_3 = Custom[CW.InternalUnit.ToDisplayUnit](VARval=getItemAtIndex_3, VARdisplayUnitType=displayUnitType.VARdisplayUnitType)
replaceItemAtIndex_3 = List.ReplaceItemAtIndex(list=replaceItemAtIndex_2, index=code_block_3.out2, item=toDisplayUnit_3)
getItemAtIndex_4 = List.GetItemAtIndex(list=watch_5, index=code_block_3.out3)
toDisplayUnit_4 = Custom[CW.InternalUnit.ToDisplayUnit](VARval=getItemAtIndex_4, VARdisplayUnitType=displayUnitType.VARdisplayUnitType)
replaceItemAtIndex_4 = List.ReplaceItemAtIndex(list=replaceItemAtIndex_3, index=code_block_3.out3, item=toDisplayUnit_4)

# group: Create Combined List with Headers
excel_column_headers = CodeBlock { ["View Element ID","View Name","Top Clip Plane (Level)","Top Clip Plane Offset", "Cut Plane (Level)", "Cut Plane Offset", "Bottom Clip Plane (Level)", "Bottom Clip Plane Offset", "View Depth (Level)", "View Depth Offset"]; }
create_2 = List.Create(item0=excel_column_headers)
create_3 = List.Create(item0=id, item1=flatten)
join = List.Join(list0=create_3, list1=replaceItemAtIndex_4)
transpose = List.Transpose(lists=join)
join_2 = List.Join(list0=create_2, list1=transpose)
watch_6 = 05.Watch(join_2)  # graph output

# group: Write Report to Excel
code_block_4 = CodeBlock { 0; 0; }
boolean_2 = BoolSelector(true)
exportExcel = Data.ExportExcel(filePath=n02_excel_file_path_to_save_to, sheetName=worksheet_name, startRow=code_block_4.out0, startColumn=code_block_4.out1, data=watch_6, overWrite=boolean_2)
watch_7 = 07.Watch(exportExcel)  # graph output

debug_python = Custom[Debug Python]()  # package Synthesize toolkit; Debug Python
