# Dynamo graph Views.Rename By Beginning and End Remove.dyn (Dynamo 2.13.1.3887)
# author: karam@aecedx.com
# packages: Synthesize toolkit 12.5.1

# group: Input
n05_proceed = BoolSelector(false)  # "05.Proceed ?"; graph input
n01_element_types = ElementTypes("ViewPlan")  # "01.Element Types"; graph input
n02_filter_parameter = StringInput("Sync with Dynamo")  # "02.Filter Parameter"; graph input
n09_view_name_parameter = StringInput("View Name")  # "09.View Name Parameter"; graph input
n03_number_of_chars_to_remove = DoubleInput(1)  # "03.Number of Chars to Remove From The Beginning"; graph input
n04_number_of_chars_to_remove = DoubleInput(1)  # "04.Number of Chars to Remove From The End"; graph input
n06_write_a_backup_to_csv = BoolSelector(false)  # "06.Write a Backup to CSV"; graph input
n07_overrides_file = StringInput("C:\Users\karam\Desktop\Dynamo Views Backup Values.csv")  # "07.Overrides File"; graph input
n08_overwrite_existing_excel_file = BoolSelector(false)  # "08.Overwrite Existing Excel File"; graph input

all_elements_of_type = ElementsOfType(element_type=n01_element_types)
getParameterValueByName = Element.GetParameterValueByName(element=all_elements_of_type, parameterName=n02_filter_parameter)
code_block = CodeBlock { 1; }
eq = getParameterValueByName == code_block
filterByBoolMask = List.FilterByBoolMask(list=all_elements_of_type, mask=eq)
code_block_2 = CodeBlock { null; false; }
scopeIf = Custom[CW.ScopeIf+](VARtest=n05_proceed, VARtrue=filterByBoolMask.in, VARfalse=code_block_2.out0)  # package Synthesize toolkit; A (hopefully) more robust implementation of ScopeIf. Tests a single boolean and returns a value accordingly.
clean = List.Clean(list=scopeIf, preserveIndices=code_block_2.out1)
scopeIf_2 = Custom[CW.ScopeIf+](VARtest=n05_proceed, VARtrue=n09_view_name_parameter, VARfalse=code_block_2.out0)
clean_2 = List.Clean(list=scopeIf_2, preserveIndices=code_block_2.out1)
getParameterValueByName_2 = Element.GetParameterValueByName(element=filterByBoolMask.in, parameterName=n09_view_name_parameter)
removeFromBegin = Custom[RA.String.RemoveFromBegin](VARStr=getParameterValueByName_2, VARNumberToRemove=n03_number_of_chars_to_remove)  # package Synthesize toolkit; Remove characters from the beginning of a string by a given amount
removeFromEnd = Custom[RA.String.RemoveFromEnd](VARStr=removeFromBegin, VARNumberToRemove=n04_number_of_chars_to_remove)  # package Synthesize toolkit; Remove characters from the end of a string by a given amount
scopeIf_3 = Custom[CW.ScopeIf+](VARtest=n05_proceed, VARtrue=removeFromEnd, VARfalse=code_block_2.out0)
clean_3 = List.Clean(list=scopeIf_3, preserveIndices=code_block_2.out1)
setParameterByName = Element.SetParameterByName(element=clean, parameterName=clean_2, value=clean_3, lacing=Longest)

# group: Report
n01_original_names = Watch(getParameterValueByName_2)  # "01.Original Names"; graph output
n02_resulted_names = Watch(removeFromEnd)  # "02.Resulted Names"; graph output

code_block_3 = CodeBlock { null; false; }
scopeIf_4 = Custom[CW.ScopeIf+](VARtest=n06_write_a_backup_to_csv, VARtrue=n07_overrides_file, VARfalse=code_block_3.out0)
create = List.Create(item0=scopeIf_4)
code_block_4 = CodeBlock { null; false; }
join = List.Join()  # unwired: list0, list1
id = Element.Id(element=filterByBoolMask.in)
combine = List.Combine(comb=join, list1=id, list2=getParameterValueByName_2)
fileExists = FileSystem.FileExists(path=n07_overrides_file)
fromPath = FileObject(path=n07_overrides_file)  # "File.FromPath"
code_block_5 = CodeBlock { null; }
scopeIf_5 = Custom[CW.ScopeIf+](VARtest=fileExists, VARtrue=fromPath, VARfalse=code_block_5)
create_2 = List.Create(item0=scopeIf_5)
code_block_6 = CodeBlock { false; }
clean_4 = List.Clean(list=create_2, preserveIndices=code_block_6)
flatten = List.Flatten(list=clean_4)
importCSV = Data.ImportCSV(filePath=flatten)
flatten_2 = List.Flatten(list=importCSV@L2)
join_2 = List.Join(list0=combine, list1=flatten_2)
uniqueItems = List.UniqueItems(list=join_2)
code_block_7 = CodeBlock { "ProtoCore.DSASM.StackValue"; }
eq_2 = uniqueItems == code_block_7
filterByBoolMask_2 = List.FilterByBoolMask(list=uniqueItems, mask=eq_2)
code_block_8 = CodeBlock { false; }
clean_5 = List.Clean(list=filterByBoolMask_2.out, preserveIndices=code_block_8)
firstItem = List.FirstItem(list=clean_5@L2)
al_duplicate_item_indices = Custom[AL.Duplicate Item Indices](VARList=firstItem)  # package Synthesize toolkit; Searches an input list for duplicate entries and lists their index numbers. Couple with Get From List to delete duplicates from a list.
getItemAtIndex = List.GetItemAtIndex(list=clean_5, index=al_duplicate_item_indices.VARUniqueIndices)
scopeIf_6 = Custom[CW.ScopeIf+](VARtest=n06_write_a_backup_to_csv, VARtrue=getItemAtIndex, VARfalse=code_block_3.out0)
clean_6 = List.Clean(list=scopeIf_6, preserveIndices=code_block_3.out1)
scopeIf_7 = Custom[CW.ScopeIf+](VARtest=n08_overwrite_existing_excel_file, VARtrue=code_block_4.out0, VARfalse=clean_6)
scopeIf_8 = Custom[CW.ScopeIf+](VARtest=n08_overwrite_existing_excel_file, VARtrue=combine, VARfalse=code_block_4.out0)
create_3 = List.Create(item0=scopeIf_7, item1=scopeIf_8)
clean_7 = List.Clean(list=create_3, preserveIndices=code_block_4.out1)
flatten_3 = List.Flatten(list=clean_7)
exportCSV = Data.ExportCSV(data=flatten_3)  # unwired: filePath
map = List.Map(list=create, f_x=exportCSV)
debug_python = Custom[Debug Python]()  # package Synthesize toolkit; Debug Python
