# Dynamo graph Views.Rename From Saved Backup.dyn (Dynamo 2.13.1.3887)
# author: karam@aecedx.com
# packages: Synthesize toolkit 12.5.1

# group: Input
n02_clean_the_csv_from_unused_ids = BoolSelector(true)  # "02.Clean the CSV from Unused IDs"; graph input
n01_views_name_file_path = Filename("..\..\..\..\..\..\..\..\Desktop\Dynamo Views Backup Values.csv")  # "01.Views Name File Path"; graph input
n03_proceed = BoolSelector(false)  # "03.Proceed ?"; graph input
n04_view_name_paremeter = StringInput("View Name")  # "04.View Name Paremeter"; graph input

code_block = CodeBlock { null; false; }
scopeIf = Custom[CW.ScopeIf+](VARtest=n02_clean_the_csv_from_unused_ids, VARtrue=n01_views_name_file_path, VARfalse=code_block.out0)  # package Synthesize toolkit; A (hopefully) more robust implementation of ScopeIf. Tests a single boolean and returns a value accordingly.
create = List.Create(item0=scopeIf)
fromPath = FileObject(path=n01_views_name_file_path)  # "File.FromPath"
importCSV = Data.ImportCSV(filePath=fromPath)
firstItem = List.FirstItem(list=importCSV@L2)
al_current_document = Custom[AL.Current Document]()  # package Synthesize toolkit; Retrieves Current Document
al_id_to_element = Custom[AL.Id to Element](VARDoc=al_current_document)  # package Synthesize toolkit; Selects elements in a model from id input (ElementId, string, integer or GUID); unwired: VARIds
map = List.Map(list=firstItem, f_x=al_id_to_element)
flatten = List.Flatten(list=map)
code_block_2 = CodeBlock { null; }
code_block_3 = CodeBlock { "            Invalid Id             "; }
eq = _ == code_block_3  # unwired: x
replaceByCondition = Replace(item=flatten, replaceWith=code_block_2, condition=eq)
isNull = Object.IsNull(object=replaceByCondition)
filterByBoolMask = List.FilterByBoolMask(list=importCSV, mask=isNull)
clean = List.Clean(list=filterByBoolMask.out)
exportCSV = Data.ExportCSV(data=clean)  # unwired: filePath
map_2 = List.Map(list=create, f_x=exportCSV)
isNull_2 = Object.IsNull(object=replaceByCondition)
filterByBoolMask_2 = List.FilterByBoolMask(list=replaceByCondition, mask=isNull_2)
code_block_4 = CodeBlock { null; false; }
scopeIf_2 = Custom[CW.ScopeIf+](VARtest=n03_proceed, VARtrue=filterByBoolMask_2.out, VARfalse=code_block_4.out0)
clean_2 = List.Clean(list=scopeIf_2, preserveIndices=code_block_4.out1)
flatten_2 = List.Flatten(list=clean_2)
scopeIf_3 = Custom[CW.ScopeIf+](VARtest=n03_proceed, VARtrue=n04_view_name_paremeter, VARfalse=code_block_4.out0)
clean_3 = List.Clean(list=scopeIf_3, preserveIndices=code_block_4.out1)
flatten_3 = List.Flatten(list=clean_3)
lastItem = List.LastItem(list=importCSV@L2)
filterByBoolMask_3 = List.FilterByBoolMask(list=lastItem, mask=isNull_2)
scopeIf_4 = Custom[CW.ScopeIf+](VARtest=n03_proceed, VARtrue=filterByBoolMask_3.out, VARfalse=code_block_4.out0)
clean_4 = List.Clean(list=scopeIf_4, preserveIndices=code_block_4.out1)
flatten_4 = List.Flatten(list=clean_4)
setParameterByName = Element.SetParameterByName(element=flatten_2, parameterName=flatten_3, value=flatten_4, lacing=Longest)
getParameterValueByName = Element.GetParameterValueByName(element=filterByBoolMask_2.out, parameterName=n04_view_name_paremeter)

# group: Report
n01_current_view_names = Watch(getParameterValueByName)  # "01.Current View Names"; graph output
n02_resulted_view_names = Watch(filterByBoolMask_3.out)  # "02.Resulted View Names"; graph output

debug_python = Custom[Debug Python]()  # package Synthesize toolkit; Debug Python
