# Dynamo graph Void.Auto Cut Voids with Family Type.dyn (Dynamo 2.13.1.3887)
# author: karam@aecedx.com
# packages: Synthesize toolkit 12.5.1

# group: Input
n01_select_void_elements = DSModelElementsSelection()  # "01.Select Void Elements"; nothing selected; graph input
n02_family_type_to_cut = FamilyTypes()  # "02.Family Type to Cut"; nothing selected; graph input

all_elements_of_family_type = ElementsOfFamilyType(Family_Type=n02_family_type_to_cut)
cut_elements = Custom[Cut Elements](VARVoids=n01_select_void_elements, VARElements=all_elements_of_family_type)  # package Synthesize toolkit; Cut Elements
debug_python_no_message = Custom[Debug Python No Message]()  # package Synthesize toolkit; Debug Python
