# Dynamo graph Walls.K-Explode To Onion Walls From Links.dyn (Dynamo 2.13.1.3887)
# author: karam@aecedx.com
# packages: Synthesize toolkit 12.5.1

hot_get_all_filter = Custom[HOT.Get All Filter]()  # package Synthesize toolkit; Get all Filter

# group: Input
n01_parts_filter_to_read = StringInput("Linked Walls Parts")  # "01.Parts filter to read"; graph input
proceed = BoolSelector(false)  # "03.Proceed"; graph input
n02_material_parameter_to_read = StringInput("Comments")  # "02.Material Parameter to Read"; graph input

eq = hot_get_all_filter.VARName == n01_parts_filter_to_read
filterByBoolMask = List.FilterByBoolMask(list=hot_get_all_filter.VARElement, mask=eq)
elements = Custom[CW.SelectionSet.Elements](VARselectionSet=filterByBoolMask.in)  # package Synthesize toolkit; Retrieves all elements stored in a selection set
flatten = List.Flatten(list=elements)
geometry = Element.Geometry(element=flatten)
explode = Geometry.Explode(geometry=geometry)
filterByOrientation = Custom[CW.Surface.FilterByOrientation](VARsurfaces=explode)  # package Synthesize toolkit; Sorts surfaces in three lists based on their orientation (vertical, horizontal up & horizontal down) and also returns three corresponding lists of booleans.
flatten_2 = List.Flatten(list=filterByOrientation.VARhorizontalDown)
perimeterCurves = Surface.PerimeterCurves(surface=flatten_2)
length = Curve.Length(curve=perimeterCurves)
maximumItem = List.MaximumItem(list=length)
join = List.Join()  # unwired: list0, list1
code_block = CodeBlock { 2; }
chop = List.Chop(lengths=code_block)  # unwired: list
map = List.Map(list=perimeterCurves, f_x=chop)
chop_2 = List.Chop(lengths=code_block)  # unwired: list
map_2 = List.Map(list=length, f_x=chop_2)
maximumItem_2 = List.MaximumItem()  # unwired: list
map_3 = List.Map(list=map_2, f_x=maximumItem_2)
eq_2 = map_2 == map_3
filterByBoolMask_2 = List.FilterByBoolMask(list=map, mask=eq_2)
flatten_3 = List.Flatten()  # unwired: list
map_4 = List.Map(list=filterByBoolMask_2.out, f_x=flatten_3)
code_block_2 = CodeBlock { 0.5; }
pointAtParameter = Curve.PointAtParameter(curve=map_4, param=code_block_2)
flatten_4 = List.Flatten()  # unwired: list
map_5 = List.Map(list=filterByBoolMask_2.in, f_x=flatten_4)
pointAtParameter_2 = Curve.PointAtParameter(curve=map_5, param=code_block_2)
byBestFitThroughPoints = Line.ByBestFitThroughPoints()  # unwired: bestFitPoints
map_6 = List.Map(list=pointAtParameter_2, f_x=byBestFitThroughPoints)
pointAtParameter_3 = Curve.PointAtParameter(curve=map_6, param=code_block_2)
combine = List.Combine(comb=join, list1=pointAtParameter, list2=pointAtParameter_3)
byBestFitThroughPoints_2 = Arc.ByBestFitThroughPoints()  # unwired: points
map_7 = List.Map(list=combine, f_x=byBestFitThroughPoints_2)
isNull = Object.IsNull(object=map_7)
filterByBoolMask_3 = List.FilterByBoolMask(list=map_7, mask=isNull)
filterByBoolMask_4 = List.FilterByBoolMask(list=combine, mask=isNull)
byBestFitThroughPoints_3 = Line.ByBestFitThroughPoints()  # unwired: bestFitPoints
map_8 = List.Map(list=filterByBoolMask_4.in, f_x=byBestFitThroughPoints_3)
join_2 = List.Join(list0=filterByBoolMask_3.out, list1=map_8)
watch = 02.Watch(flatten)  # graph output
code_block_3 = CodeBlock { "Height"; "Base Level"; }
getParameterValueByName = Element.GetParameterValueByName(element=watch, parameterName=code_block_3.out0)
code_block_4 = CodeBlock { null; false; }
scopeIf = Custom[CW.ScopeIf+](VARtest=proceed, VARtrue=getParameterValueByName, VARfalse=code_block_4.out0)  # package Synthesize toolkit; A (hopefully) more robust implementation of ScopeIf. Tests a single boolean and returns a value accordingly.
clean = List.Clean(list=scopeIf, preserveIndices=code_block_4.out1)
filterByBoolMask_5 = List.FilterByBoolMask(list=clean, mask=isNull)
join_3 = List.Join(list0=filterByBoolMask_5.out, list1=filterByBoolMask_5.in)
getParameterValueByName_2 = Element.GetParameterValueByName(element=watch, parameterName=code_block_3.out1)
scopeIf_2 = Custom[CW.ScopeIf+](VARtest=proceed, VARtrue=getParameterValueByName_2, VARfalse=code_block_4.out0)
clean_2 = List.Clean(list=scopeIf_2, preserveIndices=code_block_4.out1)
filterByBoolMask_6 = List.FilterByBoolMask(list=clean_2, mask=isNull)
join_4 = List.Join(list0=filterByBoolMask_6.out, list1=filterByBoolMask_6.in)
wall_type_parameter_in_parts_to = StringInput("Material")  # "Wall Type Parameter in Parts to look for"
getParameterValueByName_3 = Element.GetParameterValueByName(element=watch, parameterName=wall_type_parameter_in_parts_to)
getParameterValueByName_4 = Element.GetParameterValueByName(element=getParameterValueByName_3, parameterName=n02_material_parameter_to_read)
byName = WallType.ByName()  # unwired: name
map_9 = List.Map(list=getParameterValueByName_4, f_x=byName)
scopeIf_3 = Custom[CW.ScopeIf+](VARtest=proceed, VARtrue=map_9, VARfalse=code_block_4.out0)
clean_3 = List.Clean(list=scopeIf_3, preserveIndices=code_block_4.out1)
filterByBoolMask_7 = List.FilterByBoolMask(list=clean_3, mask=isNull)
join_5 = List.Join(list0=filterByBoolMask_7.out, list1=filterByBoolMask_7.in)
byCurveAndHeight = Wall.ByCurveAndHeight(curve=join_2, height=join_3, level=join_4, wallType=join_5)
passthrough = Custom[CW.Passthrough](VARwaitFor=explode)  # package Synthesize toolkit; Forces a sequential order of execution. The node wired into the output of the Passthrough node will be executed *after* the node wired into the waitFor input (e.g. important for some Revit operations). The value of the passThrough input will be passed on to the node wired into the output port of the Passthrough node.; unwired: VARpassThrough
code_block_5 = CodeBlock { false; }
passthrough_2 = Custom[CW.Passthrough](VARpassThrough=code_block_5, VARwaitFor=explode)
allowDisallowWallJoinAtEnd = Custom[HOT.AllowDisallowWallJoinAtEnd](VARElements=passthrough, VARBool=passthrough_2)  # package Synthesize toolkit; Allow/Disallow Wall Join At End. True=Allow.WallJoinAtEnd False=Disallow.WallJoinAtEnd
watch_2 = 01.Watch(filterByBoolMask_2.out)  # graph output
flatten_5 = List.Flatten()  # unwired: list
map_10 = List.Map(list=watch_2, f_x=flatten_5)
watch_3 = 03.Watch(filterByBoolMask_3.out)  # graph output

# group: Usage
notes = StringInput("""1- Use Parts.From Links Create

2- Load the parts filter created from Parts.From Links Create

3- Divide by levels 

4- Use Parts.Level Auto Fix

5- Select all parts again

6- Then save to a new selection set (Name it X for example)

7- Use Walls.K-Explode from Links now, and choose the filter "X" you created in previous step

-Karam Baki""")  # "04.Notes"; graph input

isNull_2 = Object.IsNull(object=map_9)
filterByBoolMask_8 = List.FilterByBoolMask(list=getParameterValueByName_4, mask=isNull_2)
uniqueItems = List.UniqueItems(list=filterByBoolMask_8.in)
isEmpty = List.IsEmpty(list=uniqueItems)
code_block_6 = CodeBlock { "None"; }
create = List.Create(item0=uniqueItems)
code_block_7 = CodeBlock { null; }
replaceEmptyLists = Custom[CW.List.ReplaceEmptyLists](VARseq=create, VARReplacement=code_block_7)  # package Synthesize toolkit; Replaces all empty lists within a given list with a substitute
scopeIf_4 = Custom[CW.ScopeIf+](VARtest=isEmpty, VARtrue=code_block_6, VARfalse=replaceEmptyLists)
flatten_6 = List.Flatten(list=scopeIf_4)
count = List.Count(list=flatten)

# group: Report
n04_missing_types = Watch(flatten_6)  # "04.Missing Types"; graph output
n05_number_of_new_exploded_walls = Watch(count)  # "05.Number of New Exploded Walls from Parts of the Full walls"; graph output

debug_python = Custom[Debug Python]()  # package Synthesize toolkit; Debug Python
