# Dynamo graph Walls.Stacked Walls Breakup.dyn (Dynamo 2.13.1.3887)
# author: karam@aecedx.com
# packages: Synthesize toolkit 12.5.1

# group: Input
n01_select_stacked_walls = DSModelElementsSelection()  # "01.Select Stacked Walls"; nothing selected; graph input
n02_delete_original = BoolSelector(true)  # "02.Delete Original ?"; graph input

getCategory = Element.GetCategory(element=n01_select_stacked_walls)
string_from_object = FromObject(obj=getCategory)
code_block = CodeBlock { "Walls - Stacked Walls"; }
eq = string_from_object == code_block
filterByBoolMask = List.FilterByBoolMask(list=n01_select_stacked_walls, mask=eq)
count = List.Count(list=filterByBoolMask.in)
python_script = Python(IN[0]=filterByBoolMask.in)  # IronPython2
# ---------- python_script.python (29 lines) ----------
# Enable Python support and load DesignScript library
# IMPORTANT : ALL DYNAMO DESIGN SCRIPT NODES ARE AS (dg)
import clr
clr.AddReference('ProtoGeometry')
from Autodesk.DesignScript import Geometry as dg

# Enable Revit API
clr.AddReference('RevitAPI')
from Autodesk.Revit.DB import *

# Enable DocumentManager and TransactionManager
clr.AddReference('RevitServices')
from RevitServices.Persistence import DocumentManager
from RevitServices.Transactions import TransactionManager

walls = UnwrapElement(IN[0])
doc = DocumentManager.Instance.CurrentDBDocument
result = []

TransactionManager.Instance.EnsureInTransaction(doc)

for eachwall in walls:
	members = eachwall.GetStackedWallMemberIds()
	result.append(ElementTransformUtils.CopyElements(doc, members, XYZ.Zero));

TransactionManager.Instance.TransactionTaskDone()

# Assign your output to the OUT variable.
OUT = result
# ----------------------------------------
al_current_document = Custom[AL.Current Document]()  # package Synthesize toolkit; Retrieves Current Document
al_id_to_element = Custom[AL.Id to Element](VARIds=python_script, VARDoc=al_current_document)  # package Synthesize toolkit; Selects elements in a model from id input (ElementId, string, integer or GUID)
flatten = List.Flatten(list=al_id_to_element)
count_2 = List.Count(list=flatten)
count_3 = List.Count(list=al_id_to_element@L2)

# group: Report
n01_number_of_stacked_walls = Watch(count)  # "01.Number of Stacked Walls Selected"; graph output
n02_total_number_of_walls_created = Watch(count_2)  # "02.Total Number of Walls Created"; graph output
n03_detailed_numbers_of_walls = Watch(count_3)  # "03.Detailed Numbers of Walls Created"; graph output

passthrough = Custom[CW.Passthrough](VARpassThrough=filterByBoolMask.in, VARwaitFor=al_id_to_element)  # package Synthesize toolkit; Forces a sequential order of execution. The node wired into the output of the Passthrough node will be executed *after* the node wired into the waitFor input (e.g. important for some Revit operations). The value of the passThrough input will be passed on to the node wired into the output port of the Passthrough node.
empty = List.Empty()
scopeIf = Custom[CW.ScopeIf+](VARtest=n02_delete_original, VARtrue=passthrough, VARfalse=empty)  # package Synthesize toolkit; A (hopefully) more robust implementation of ScopeIf. Tests a single boolean and returns a value accordingly.
eraser = Custom[ST.Tool.Eraser](VARList=scopeIf)  # package Synthesize toolkit; Try to delete any element from project
code_block_2 = CodeBlock { false; }
code_block_3 = CodeBlock { "Location Line"; }
code_block_4 = CodeBlock { 0; }
setParameterByName = Element.SetParameterByName(element=flatten, parameterName=code_block_3, value=code_block_4)
code_block_5 = CodeBlock { "Base Offset"; "Base Constraint"; }
categories = Categories("OST_Levels")
all_elements_of_category = ElementsOfCategory(Category=categories)
boundingBox = Element.BoundingBox(element=flatten)
minPoint = BoundingBox.MinPoint(boundingBox=boundingBox)
fix_factor_depends_of_project = DoubleInput(1000)  # "Fix Factor (Depends of Project Units, 1 For meters for example, and 100 for Centimeters)"
points_refine_levels_and_offset = Custom[Points Refine Levels and Offset](VARLevels=all_elements_of_category, VARPoints=minPoint, VARFixFactorDependsofProjectUnits1Formetersforexampleand100forCentimeters=fix_factor_depends_of_project)  # package Synthesize toolkit; Family Refine Levels and Offset
setParameterByName_2 = Element.SetParameterByName(element=setParameterByName, parameterName=code_block_5.out1, value=points_refine_levels_and_offset.VARLevelsSet)
code_block_6 = CodeBlock { "Top Offset"; "Top Constraint"; }
X = Point.X(point=minPoint)
Y = Point.Y(point=minPoint)
code_block_7 = CodeBlock { "Unconnected Height"; }
getParameterValueByName = Element.GetParameterValueByName(element=flatten, parameterName=code_block_7)
Z = Point.Z(point=minPoint)
code_block_8 = CodeBlock(a=getParameterValueByName, b=Z) { a+b; }
byCoordinates = Point.ByCoordinates(x=X, y=Y, z=code_block_8)
points_refine_levels_and_offset_2 = Custom[Points Refine Levels and Offset](VARLevels=all_elements_of_category, VARPoints=byCoordinates, VARFixFactorDependsofProjectUnits1Formetersforexampleand100forCentimeters=fix_factor_depends_of_project)
setParameterByName_3 = Element.SetParameterByName(element=setParameterByName, parameterName=code_block_6.out0, value=points_refine_levels_and_offset_2.VARElevationsSet)
setParameterByName_4 = Element.SetParameterByName(element=setParameterByName, parameterName=code_block_6.out1, value=points_refine_levels_and_offset_2.VARLevelsSet)
setParameterByName_5 = Element.SetParameterByName(element=setParameterByName, parameterName=code_block_5.out0, value=points_refine_levels_and_offset.VARElevationsSet)
python_script_2 = Python(IN[0]=filterByBoolMask.in)  # IronPython2
# ---------- python_script_2.python (14 lines) ----------
import clr
clr.AddReference("RevitNodes")
import Revit
clr.ImportExtensions(Revit.Elements)


element = list(UnwrapElement(IN[0]))

result = []

result = [ (True if i.Flipped and i.Flipped else False) for i in element ]

#Assign output to the OUT variable
OUT = result
# ----------------------------------------
filterByBoolMask_2 = List.FilterByBoolMask(list=al_id_to_element, mask=python_script_2)
flatten_2 = List.Flatten(list=filterByBoolMask_2.in)
passthrough_2 = Custom[CW.Passthrough](VARpassThrough=flatten_2, VARwaitFor=setParameterByName)
flip = Custom[CW.Wall.Flip](VARwall=passthrough_2)  # package Synthesize toolkit; Flips the orientation of a given wall - DO ***NOT*** USE IN AUTOMATIC MODE
debug_python = Custom[Debug Python]()  # package Synthesize toolkit; Debug Python
