# Dynamo graph Walls.Wall By Edges Selection.dyn (Dynamo 2.13.1.3887)
# author: karam@aecedx.com
# packages: Synthesize toolkit 12.5.1

# group: Input
n05_create_selection_filter = BoolSelector(true)  # "05.Create Selection Filter ?"; graph input
n06_selection_filter_name = StringInput("Dynamo Walls By Edges Selection")  # "06.Selection Filter Name"; graph input
n07_overwrite_existing_filter = BoolSelector(false)  # "07.Overwrite Existing Filter ? (False for Adding Elements)"; graph input
n01_select_edges = SelectEdges()  # "01.Select Edges"; nothing selected; graph input
n03_wall_type = WallTypes()  # "03.Wall Type"; nothing selected; graph input
height = DoubleInput(4)  # "04.Height"; graph input
n02_1_finish_face_interior_2 = IntegerSlider(1, range=1..3 step 1)  # "02.1 = Finish Face Interior | 2 = Finish Face Exterior | 3 = Wall Centerline"; graph input

turnIntoList = Custom[CW.TurnIntoList](VARunknownItem=n01_select_edges)  # package Synthesize toolkit; Turns an element (or a nested list) into a flat list
categories = Categories("OST_Levels")
all_elements_of_category = ElementsOfCategory(Category=categories)
startPoint = Curve.StartPoint(curve=turnIntoList)
code_block = CodeBlock { 1000; }
points_refine_levels_and_offset = Custom[Points Refine Levels and Offset](VARLevels=all_elements_of_category, VARPoints=startPoint, VARFixFactorDependsofProjectUnits1Formetersforexampleand100forCentimeters=code_block)  # package Synthesize toolkit; Family Refine Levels and Offset
count = List.Count(list=turnIntoList)
cycle = List.Cycle(list=height, amount=count)
walls_by_curves = Custom[Walls By Curves](VARCurves=turnIntoList, VARWallType=n03_wall_type, VARLevels=points_refine_levels_and_offset.VARLevelsSet, VARHeights=cycle, VAROffsets=points_refine_levels_and_offset.VARElevationsSet, VARLocationLine=n02_1_finish_face_interior_2)  # package Synthesize toolkit; Walls By Curves
generate_selection_filter = Custom[Generate Selection Filter](VARCreateSelectionFilter=n05_create_selection_filter, VARFilterNametoCreate=n06_selection_filter_name, VAROverwriteExistingFilter=n07_overwrite_existing_filter, VARElements=walls_by_curves)  # package Synthesize toolkit; Generate Selection FIlter
debug_python = Custom[Debug Python]()  # package Synthesize toolkit; Debug Python
