# Dynamo graph Walls.Wall By Edges of Faces Selection.dyn (Dynamo 2.13.1.3887)
# author: karam@aecedx.com
# packages: Synthesize toolkit 12.5.1

# group: Input
n06_create_selection_filter = BoolSelector(true)  # "06.Create Selection Filter ?"; graph input
n07_selection_filter_name = StringInput("Dynamo Walls By Edges of Faces Selection")  # "07.Selection Filter Name"; graph input
n08_overwrite_existing_filter = BoolSelector(false)  # "08.Overwrite Existing Filter ? (False for Adding Elements)"; graph input
n01_select_surfaces = SelectFaces()  # "01.Select Surfaces"; nothing selected; graph input
n03_method_1_horizontal_up_faces = IntegerSlider(1, range=1..3 step 1)  # "03.Method (1 = Horizontal Up Faces | 2 = Horizontal Down Faces | 3 = All Faces)"; graph input
n04_wall_type = WallTypes()  # "04.Wall Type"; nothing selected; graph input
n05_wall_height = DoubleInput(4)  # "05.Wall Height"; graph input
n02_1_finish_face_interior_2 = IntegerSlider(1, range=1..3 step 1)  # "02.1 = Finish Face Interior | 2 = Finish Face Exterior | 3 = Wall Centerline"; graph input

turnIntoList = Custom[CW.TurnIntoList](VARunknownItem=n01_select_surfaces)  # package Synthesize toolkit; Turns an element (or a nested list) into a flat list
flatten = List.Flatten(list=turnIntoList)
code_block = CodeBlock { "Surface"; }
byClassName = Custom[SP.Filter.ByClassName](VARobject=flatten, VARclassName=code_block)  # package Synthesize toolkit; Filters a list of objects by the object's class name. Note that Dynamo elements belong to different classes than their Revit counterparts. Use the Object.Class node to check an object's class.
python_script = Python(IN[0]=n03_method_1_horizontal_up_faces)  # IronPython2
# ---------- python_script.python (13 lines) ----------
import clr
clr.AddReference('ProtoGeometry')
from Autodesk.DesignScript.Geometry import *
#The inputs to this node will be stored as a list in the IN variables.
dataEnteringNode = IN

method = IN[0]
if method == 1:
	OUT = 2
elif method == 2:
	OUT = 3
else:
	OUT = 23
# ----------------------------------------
surface_orientation_filter = Custom[Surface Orientation Filter](VARSurfaces=byClassName.VARin, VAROrienataion=python_script)  # package Synthesize toolkit; Face Filter
perimeterCurves = Surface.PerimeterCurves(surface=surface_orientation_filter.VARSurfaces)
flatten_2 = List.Flatten(list=perimeterCurves)
categories = Categories("OST_Levels")
all_elements_of_category = ElementsOfCategory(Category=categories)
startPoint = Curve.StartPoint(curve=flatten_2)
code_block_2 = CodeBlock { 1000; }
points_refine_levels_and_offset = Custom[Points Refine Levels and Offset](VARLevels=all_elements_of_category, VARPoints=startPoint, VARFixFactorDependsofProjectUnits1Formetersforexampleand100forCentimeters=code_block_2)  # package Synthesize toolkit; Family Refine Levels and Offset
count = List.Count(list=flatten_2)
cycle = List.Cycle(list=n05_wall_height, amount=count)
walls_by_curves = Custom[Walls By Curves](VARCurves=flatten_2, VARWallType=n04_wall_type, VARLevels=points_refine_levels_and_offset.VARLevelsSet, VARHeights=cycle, VAROffsets=points_refine_levels_and_offset.VARElevationsSet, VARLocationLine=n02_1_finish_face_interior_2)  # package Synthesize toolkit; Walls By Curves
generate_selection_filter = Custom[Generate Selection Filter](VARCreateSelectionFilter=n06_create_selection_filter, VARFilterNametoCreate=n07_selection_filter_name, VAROverwriteExistingFilter=n08_overwrite_existing_filter, VARElements=walls_by_curves)  # package Synthesize toolkit; Generate Selection FIlter
debug_python = Custom[Debug Python]()  # package Synthesize toolkit; Debug Python
