# Dynamo graph Walls.Wall By Intersects of Masses.dyn (Dynamo 2.13.1.3887)
# author: karam@aecedx.com
# packages: Synthesize toolkit 12.5.1

# group: Input
n05_borders_inner_offset = DoubleInput(0)  # "05.Borders Inner Offset"; graph input
n04_delete_selected_walls_after = BoolSelector(false)  # "04.Delete Selected Walls After Mass Surfaces Creation"; graph input
n02_select_walls = DSModelElementsSelection()  # "02.Select Walls"; nothing selected; graph input
n01_select_masses = DSModelElementsSelection()  # "01.Select Masses"; nothing selected; graph input
n03_inverted_surfaces_with_solid = BoolSelector(false)  # "03.Inverted Surfaces (With Solid Intersection) - Revit 2022 or Newer"; graph input
n06_family_name = StringInput("Dynamo Wall Intersects Family")  # "06.Family Name"; graph input
category = Categories("OST_Mass")  # "07.Category"; graph input
n08_family_template_of_the_above = Filename("..\..\..\..\..\..\..\..\..\..\ProgramData\Autodesk\RVT 2020\Family Templates\English\Conceptual Mass\Metric Mass.rft")  # "08.Family Template of The Above Category"; graph input

code_block = CodeBlock { 0; }
eq = n05_borders_inner_offset == code_block
code_block_2 = CodeBlock { "Wall"; }
byClassName = Custom[SP.Filter.ByClassName](VARobject=n02_select_walls, VARclassName=code_block_2)  # package Synthesize toolkit; Filters a list of objects by the object's class name. Note that Dynamo elements belong to different classes than their Revit counterparts. Use the Object.Class node to check an object's class.
flatten = List.Flatten(list=n01_select_masses)
element_geometry_fixer = Custom[Element.Geometry Fixer](VARElement=flatten)  # package Synthesize toolkit; Element.Geometry Fixer
flatten_2 = List.Flatten(list=element_geometry_fixer)
code_block_3 = CodeBlock { "Surface"; }
byClassName_2 = Custom[SP.Filter.ByClassName](VARobject=flatten_2, VARclassName=code_block_3)
code_block_4 = CodeBlock { true; }
element_geometry_fixer_2 = Custom[Element.Geometry Fixer](VARElement=byClassName.VARin, VARFullUnjoinedGeometry=code_block_4)
flatten_3 = List.Flatten(list=element_geometry_fixer_2)
explode = Geometry.Explode(geometry=flatten_3)
filterByOrientation = Custom[CW.Surface.FilterByOrientation](VARsurfaces=explode)  # package Synthesize toolkit; Sorts surfaces in three lists based on their orientation (vertical, horizontal up & horizontal down) and also returns three corresponding lists of booleans.
area = Surface.Area(surface=filterByOrientation.VARvertical)
maximumItem = List.MaximumItem(list=area)
eq_2 = area == maximumItem
filterByBoolMask = List.FilterByBoolMask(list=filterByOrientation.VARvertical, mask=eq_2)
firstItem = List.FirstItem(list=filterByBoolMask.in@L2)
code_block_5 = CodeBlock { 1; }
chop = List.Chop(list=firstItem, lengths=code_block_5)
flatten_4 = List.Flatten(list=chop)
python_script = Python(IN[0]=byClassName_2.VARout, IN[1]=flatten_4, IN[2]=n03_inverted_surfaces_with_solid)  # IronPython2
# ---------- python_script.python (67 lines) ----------
# Enable Python support and load DesignScript library
# IMPORTANT : ALL DYNAMO DESIGN SCRIPT NODES ARE AS (dg)
import clr
clr.AddReference('ProtoGeometry')
from Autodesk.DesignScript import Geometry as dg

# EXTENSION Enable ToDSType
clr.AddReference('RevitNodes')
import Revit
clr.ImportExtensions(Revit.Elements)

# Enable Revit Elements
from Revit.Elements import *

# EXTENSION Enable Geometry Conversion Methods
clr.ImportExtensions(Revit.GeometryConversion)

# Enable Revit API
clr.AddReference('RevitAPI')
from Autodesk.Revit.DB import *

# Enable DocumentManager and TransactionManager
clr.AddReference('RevitServices')
from RevitServices.Persistence import DocumentManager
from RevitServices.Transactions import TransactionManager

# Enable ICollection List Translate
clr.AddReference("System")
import System.Collections.Generic
from System.Collections.Generic import List

clr.AddReference("RevitAPIUI")
from Autodesk.Revit.UI import TaskDialog

dataEnteringNode = IN
# Use UnwrapElement(IN[0]) When Translating From Dynamo to Revit
solids=UnwrapElement(IN[0])
wallsurfs=UnwrapElement(IN[1])
invert=IN[2]

# Choose The Current Document
doc = DocumentManager.Instance.CurrentDBDocument
uidoc = DocumentManager.Instance.CurrentUIApplication.ActiveUIDocument
uiapp = DocumentManager.Instance.CurrentUIApplication
app = uiapp.Application

# Create Empty List
result = []

needsMsg = False

for sur in wallsurfs:
	for s in solids:
		if dg.Geometry.DoesIntersect(sur,s):
			if invert and int(DocumentManager.Instance.CurrentUIApplication.Application.VersionNumber) > 2021:
				sur = dg.Geometry.Explode(dg.Surface.Difference(sur,dg.Geometry.Intersect(sur,s)))
			else:
				sur = dg.Geometry.Intersect(sur,s)
				if invert:
					needsMsg = True
	result.append(sur)

if needsMsg:
	TaskDialog.Show("AECedx - Karam", "Use Revit 2022 For Inverted Surfaces")

# Assign your output to the OUT variable.
OUT = result
# ----------------------------------------
as_geometry_splitbytools = Custom[AS.[&] Geometry.SplitByTools](VARgeometry=python_script@L2, VARtools=byClassName_2.VARin)  # package Synthesize toolkit; Split one piece of geometry (other than a polysurface) by multiple tools
flatten_5 = List.Flatten(list=as_geometry_splitbytools)
surfaces_border_offset = Custom[Surfaces Border Offset](VARSurfaces=flatten_5, VAROffset=n05_borders_inner_offset)  # package Synthesize toolkit; Surfaces Border Offset
create = List.Create(item0=surfaces_border_offset.VARExtraFrameOnly, item1=surfaces_border_offset.VARFrameSolids)
code_block_6 = CodeBlock { false; }
clean = List.Clean(list=create, preserveIndices=code_block_6)
flatten_6 = List.Flatten(list=clean)
k_family_insert = Custom[K-Family Insert](VARGeometryorSAT=flatten_6, VARFamilyName=n06_family_name, VARFamilyCategory=category, VARFamilyTemplatePath=n08_family_template_of_the_above)  # package Synthesize toolkit; K-Family Insert
passthrough = Custom[CW.Passthrough](VARpassThrough=byClassName.VARin, VARwaitFor=k_family_insert.VARFamilyInstancesOrImportSymbols)  # package Synthesize toolkit; Forces a sequential order of execution. The node wired into the output of the Passthrough node will be executed *after* the node wired into the waitFor input (e.g. important for some Revit operations). The value of the passThrough input will be passed on to the node wired into the output port of the Passthrough node.
empty = List.Empty()
scopeIf = Custom[CW.ScopeIf+](VARtest=n04_delete_selected_walls_after, VARtrue=passthrough, VARfalse=empty)  # package Synthesize toolkit; A (hopefully) more robust implementation of ScopeIf. Tests a single boolean and returns a value accordingly.
empty_2 = List.Empty()
scopeIf_2 = Custom[CW.ScopeIf+](VARtest=eq, VARtrue=scopeIf, VARfalse=empty_2)
eraser = Custom[ST.Tool.Eraser](VARList=scopeIf_2)  # package Synthesize toolkit; Try to delete any element from project
scopeIf_3 = Custom[CW.ScopeIf+](VARtest=eq, VARtrue=empty_2, VARfalse=scopeIf)
code_block_7 = CodeBlock { 1.3; }
update_dynamo_wait = Custom[Update Dynamo Wait](VARWait=scopeIf_3, VARVersion=code_block_7)  # package Synthesize toolkit; Update Dynamo Wait
eraser_2 = Custom[ST.Tool.Eraser](VARList=update_dynamo_wait)
debug_python_no_message = Custom[Debug Python No Message]()  # package Synthesize toolkit; Debug Python
