# Dynamo graph Walls.Wall By Surfaces Selection.dyn (Dynamo 2.13.1.3887)
# author: karam@aecedx.com
# packages: Synthesize toolkit 12.5.1

# group: Input
n01_select_faces = SelectFaces()  # "01.Select Faces"; nothing selected; graph input
n04_wall_types = WallTypes()  # "04.Wall Types"; nothing selected; graph input
n03_1_finish_face_interior_2 = IntegerSlider(1, range=1..3 step 1)  # "03.1 = Finish Face Interior | 2 = Finish Face Exterior | 3 = Wall Centerline"; graph input
n06_segmentation_distance = DoubleInput(1)  # "06.Segmentation Distance"; graph input
n05_segment_walls = BoolSelector(false)  # "05.Segment Walls ?"; graph input
n02_fetch_whole_body = BoolSelector(false)  # "02.Fetch Whole Body ?"; graph input

auto_walls_by_surfaces = Custom[Auto Walls By Surfaces](VARSurface=n01_select_faces, VARWallType=n04_wall_types, VARLocationLine=n03_1_finish_face_interior_2, VARSegmentationDistance=n06_segmentation_distance, VARSegmentWalls=n05_segment_walls, VARFetchAllSurfaces=n02_fetch_whole_body)  # package Synthesize toolkit; Auto Walls By Surfaces
debug_python = Custom[Debug Python]()  # package Synthesize toolkit; Debug Python
