# Dynamo graph Walls.Wall By Walls Selection.dyn (Dynamo 2.13.1.3887)
# author: karam@aecedx.com
# packages: Synthesize toolkit 12.5.1

# group: Input
n06_delete_old_walls = BoolSelector(false)  # "06.Delete Old Walls"; graph input
n01_select_walls = DSModelElementsSelection()  # "01.Select Walls"; nothing selected; graph input
n03_wall_type = WallTypes()  # "03.Wall Type"; nothing selected; graph input
n02_1_finish_face_interior_2 = IntegerSlider(1, range=1..3 step 1)  # "02.1 = Finish Face Interior | 2 = Finish Face Exterior | 3 = Wall Centerline"; graph input
n05_segmentation_distance = DoubleInput(1)  # "05.Segmentation Distance"; graph input
n04_segment_walls = BoolSelector(false)  # "04.Segment Walls ?"; graph input

code_block = CodeBlock { "Wall"; }
byClassName = Custom[SP.Filter.ByClassName](VARobject=n01_select_walls, VARclassName=code_block)  # package Synthesize toolkit; Filters a list of objects by the object's class name. Note that Dynamo elements belong to different classes than their Revit counterparts. Use the Object.Class node to check an object's class.
element_geometry_fixer = Custom[Element.Geometry Fixer](VARElement=byClassName.VARin)  # package Synthesize toolkit; Element.Geometry Fixer
flatten = List.Flatten(list=element_geometry_fixer)
explode = Geometry.Explode(geometry=flatten)
filterByOrientation = Custom[CW.Surface.FilterByOrientation](VARsurfaces=explode)  # package Synthesize toolkit; Sorts surfaces in three lists based on their orientation (vertical, horizontal up & horizontal down) and also returns three corresponding lists of booleans.
area = Surface.Area(surface=filterByOrientation.VARvertical)
maximumItem = List.MaximumItem(list=area)
eq = area == maximumItem
filterByBoolMask = List.FilterByBoolMask(list=filterByOrientation.VARvertical, mask=eq)
firstItem = List.FirstItem(list=filterByBoolMask.in@L2)
isPlanar = Custom[CW.Surface.IsPlanar](VARsurface=firstItem)  # package Synthesize toolkit; Checks whether a face is planar
filterByBoolMask_2 = List.FilterByBoolMask(list=byClassName.VARin, mask=isPlanar)
filterByBoolMask_3 = List.FilterByBoolMask(list=firstItem, mask=isPlanar)
code_block_2 = CodeBlock { 1; }
chop = List.Chop(list=filterByBoolMask_3.in, lengths=code_block_2)
auto_walls_by_surfaces = Custom[Auto Walls By Surfaces](VARSurface=chop, VARWallType=n03_wall_type, VARLocationLine=n02_1_finish_face_interior_2, VARSegmentationDistance=n05_segmentation_distance, VARSegmentWalls=n04_segment_walls)  # package Synthesize toolkit; Auto Walls By Surfaces
passthrough = Custom[CW.Passthrough](VARpassThrough=filterByBoolMask_2.in, VARwaitFor=auto_walls_by_surfaces)  # package Synthesize toolkit; Forces a sequential order of execution. The node wired into the output of the Passthrough node will be executed *after* the node wired into the waitFor input (e.g. important for some Revit operations). The value of the passThrough input will be passed on to the node wired into the output port of the Passthrough node.
empty = List.Empty()
scopeIf = Custom[CW.ScopeIf+](VARtest=n06_delete_old_walls, VARtrue=passthrough, VARfalse=empty)  # package Synthesize toolkit; A (hopefully) more robust implementation of ScopeIf. Tests a single boolean and returns a value accordingly.
eraser = Custom[ST.Tool.Eraser](VARList=scopeIf)  # package Synthesize toolkit; Try to delete any element from project
debug_python = Custom[Debug Python]()  # package Synthesize toolkit; Debug Python
