# Dynamo graph Boundary.dyn (Dynamo 2.6.1.8786)

number = DoubleInput(210)  # graph input
byCenterPointRadius = Circle.ByCenterPointRadius(radius=number)
regularPolygon = Polygon.RegularPolygon(circle=byCenterPointRadius)
code_block = CodeBlock { -97.729900; 30.284833; }
byCoordinates = Point.ByCoordinates(x=code_block.out0, y=code_block.out1)
imperial = TestFit.MeasurementSystem.Imperial()
file_path = Filename(".\boundary.rsd")  # graph input
toRsdFile = TestFit.PropertyLine.ToRsdFile(polygon=regularPolygon, origin=byCoordinates, system=imperial, fileName=file_path)
