# Dynamo graph Parts.dyn (Dynamo 2.0.3.8810)

file_path = Filename(".\sample.rsd")  # graph input
byRsdFile = TestFit.Building.ByRsdFile(fileName=file_path)
byBuilding = TestFit.Parts.ByBuilding(building=byRsdFile)
externalPlates = TestFit.Parts.ExternalPlates(parts=byBuilding)
internalPlates = TestFit.Parts.InternalPlates(parts=byBuilding)
unitWalls = TestFit.Parts.UnitWalls(parts=byBuilding)
